# Dynamo graph Wall Calculator_HEC(0712).dyn (Dynamo 2.10.1.3976)

# group: 함수 3-벽체면적 (Cat.1)
function_compose = ComposeFunctions()  # frozen; unwired: function0, function1
# note: target WM 입력부
code_block = CodeBlock { "Area"; }
# note: 함수1 생성 구간
getParameterValueByName = Element.GetParameterValueByName(parameterName=code_block)  # unwired: element
code_block_2 = CodeBlock()
# ---------- code_block_2.designscript (19 lines) ----------
[
"A04AS164"
,
"A04AK012"
,
"A04AL077"
,
"A04AL078"
,
"A04AK076"
,
"A04AK069"
,
"A04AK073"
//,
//""
//,
//""
];
# ----------------------------------------

# group: 함수 4-벽체길이(Cat.1)
function_compose_2 = ComposeFunctions()  # frozen; unwired: function0, function1
code_block_3 = CodeBlock { "Length"; }
# note: 함수1 생성 구간
getParameterValueByName_2 = Element.GetParameterValueByName(parameterName=code_block_3)  # unwired: element
# note: target WM 입력부
code_block_4 = CodeBlock()
# ---------- code_block_4.designscript (7 lines) ----------
[
"A04AL081"
//,
//""
//,
//""
];
# ----------------------------------------

# group: 함수 2- Formwork Area (Cat.1)
code_block_5 = CodeBlock { "Area"; }
# note: 함수1 생성 구간
getParameterValueByName_3 = Element.GetParameterValueByName(parameterName=code_block_5)  # unwired: element
code_block_6 = CodeBlock { 2; }
mul = _ * code_block_6  # unwired: x
function_compose_3 = ComposeFunctions(function0=getParameterValueByName_3, function1=mul)
# note: target WM 입력부
code_block_7 = CodeBlock()
# ---------- code_block_7.designscript (5 lines) ----------
[
"A03AD036"
//,
//""
];
# ----------------------------------------

# group: All Elements of Category - WALLS
categories = Categories("OST_Walls")
all_elements_of_category = ElementsOfCategory(Category=categories)

# group: material index
getMaterials = Element.GetMaterials(element=all_elements_of_category)
flatten = List.Flatten(list=getMaterials)
name = Element.Name(element=flatten)

# group: element별 material 개수로 함수 리스트 복제
ofRepeatedItem = List.OfRepeatedItem()  # unwired: item, amount
count = List.Count(list=getMaterials@L2)
laceShortest = List.LaceShortest(combineFunction=ofRepeatedItem, list0=all_elements_of_category, list1=count)
watch = Watch(laceShortest)
flatten_2 = List.Flatten(list=watch)

# group: target WM 적용 함수 - element 매칭 구간
map = List.Map()  # unwired: list, function
# note: 해당 함수의 target materials index 검색
contains = String.Contains(str=name@L1, searchFor=code_block_7)
anyTrue = List.AnyTrue(list=contains@L2)
code_block_8 = CodeBlock { true; }
# note: getting index of element which has target materials
allIndicesOf = List.AllIndicesOf(list=anyTrue@L2, item=code_block_8)
flatten_3 = List.Flatten(list=allIndicesOf)
count_2 = List.Count(list=flatten_3)
# note: 필요한 개수로 함수 리스트 증식
ofRepeatedItem_2 = List.OfRepeatedItem(item=function_compose_3, amount=count_2)
watch_2 = Watch(ofRepeatedItem_2)
# note: wm 별 타겟 element 추출
getItemAtIndex = List.GetItemAtIndex(list=flatten_2, index=flatten_3)
watch_3 = Watch(getItemAtIndex)
# note: 엘리먼트와 함수 1대1 매칭 적용
laceShortest_2 = List.LaceShortest(combineFunction=map, list0=watch_2, list1=watch_3)
count_3 = List.Count(list=laceShortest_2)
watch_material_index = Watch(name)

# group: target WM 적용 함수 - element 매칭 구간
map_2 = List.Map()  # unwired: list, function
# note: 해당 함수의 target materials index 검색
contains_2 = String.Contains(str=name@L1, searchFor=code_block_2)
anyTrue_2 = List.AnyTrue(list=contains_2@L2)
code_block_9 = CodeBlock { true; }
# note: getting index of element which has target materials
allIndicesOf_2 = List.AllIndicesOf(list=anyTrue_2@L2, item=code_block_9)
flatten_4 = List.Flatten(list=allIndicesOf_2)
count_4 = List.Count(list=flatten_4)
# note: 필요한 개수로 함수 리스트 증식
ofRepeatedItem_3 = List.OfRepeatedItem(item=getParameterValueByName, amount=count_4)
watch_4 = Watch(ofRepeatedItem_3)
# note: wm 별 타겟 element 추출
getItemAtIndex_2 = List.GetItemAtIndex(list=flatten_2, index=flatten_4)
watch_5 = Watch(getItemAtIndex_2)
# note: 엘리먼트와 함수 1대1 매칭 적용
laceShortest_3 = List.LaceShortest(combineFunction=map_2, list0=watch_4, list1=watch_5)
count_5 = List.Count(list=laceShortest_3)
watch_material_index_2 = Watch(name)

# group: 함수 1- Concrete Volume(Cat.1)
code_block_10 = CodeBlock { "Volume"; }
getParameterValueByName_4 = Element.GetParameterValueByName(parameterName=code_block_10)  # unwired: element
# note: target WM 입력부
code_block_11 = CodeBlock()
# ---------- code_block_11.designscript (5 lines) ----------
[
"A03AD032"
//,
//""
];
# ----------------------------------------
# note: 함수1 생성 구간
function_compose_4 = ComposeFunctions()  # frozen; unwired: function0, function1

# group: target WM 적용 함수 - element 매칭 구간
map_3 = List.Map()  # unwired: list, function
# note: 해당 함수의 target materials index 검색
contains_3 = String.Contains(str=name@L1, searchFor=code_block_11)
anyTrue_3 = List.AnyTrue(list=contains_3@L2)
code_block_12 = CodeBlock { true; }
# note: getting index of element which has target materials
allIndicesOf_3 = List.AllIndicesOf(list=anyTrue_3@L2, item=code_block_12)
flatten_5 = List.Flatten(list=allIndicesOf_3)
count_6 = List.Count(list=flatten_5)
# note: 필요한 개수로 함수 리스트 증식
ofRepeatedItem_4 = List.OfRepeatedItem(item=getParameterValueByName_4, amount=count_6)
watch_6 = Watch(ofRepeatedItem_4)
# note: wm 별 타겟 element 추출
getItemAtIndex_3 = List.GetItemAtIndex(list=flatten_2, index=flatten_5)
watch_7 = Watch(getItemAtIndex_3)
# note: 엘리먼트와 함수 1대1 매칭 적용
laceShortest_4 = List.LaceShortest(combineFunction=map_3, list0=watch_6, list1=watch_7)
count_7 = List.Count(list=laceShortest_4)
watch_material_index_3 = Watch(name)

# group: target WM 적용 함수 - element 매칭 구간
map_4 = List.Map()  # unwired: list, function
# note: 해당 함수의 target materials index 검색
contains_4 = String.Contains(str=name@L1, searchFor=code_block_4)
anyTrue_4 = List.AnyTrue(list=contains_4@L2)
code_block_13 = CodeBlock { true; }
# note: getting index of element which has target materials
allIndicesOf_4 = List.AllIndicesOf(list=anyTrue_4@L2, item=code_block_13)
flatten_6 = List.Flatten(list=allIndicesOf_4)
count_8 = List.Count(list=flatten_6)
# note: 필요한 개수로 함수 리스트 증식
ofRepeatedItem_5 = List.OfRepeatedItem(item=getParameterValueByName_2, amount=count_8)
watch_8 = Watch(ofRepeatedItem_5)
# note: wm 별 타겟 element 추출
getItemAtIndex_4 = List.GetItemAtIndex(list=flatten_2, index=flatten_6)
watch_9 = Watch(getItemAtIndex_4)
# note: 엘리먼트와 함수 1대1 매칭 적용
laceShortest_5 = List.LaceShortest(combineFunction=map_4, list0=watch_8, list1=watch_9)
count_9 = List.Count(list=laceShortest_5)
watch_material_index_4 = Watch(name)

uniqueItems = List.UniqueItems(list=name)

# group: FamilyName, WorkMasterCode, Quantities, Unit 결합구간
name_2 = Element.Name(element=watch_7)
watch_material_index_5 = Watch(watch_material_index_3)
getItemAtIndex_5 = List.GetItemAtIndex(list=watch_material_index_5, index=flatten_5)
flatten_7 = List.Flatten(list=laceShortest_4)
watch_10 = Watch(flatten_7)
code_block_14 = CodeBlock { "M3"; }
code_block_15 = CodeBlock(familyName=name_2, workmasterCode=getItemAtIndex_5, quantities=watch_10, unit=code_block_14) { familyName +"..."+ workmasterCode +"..."+ quantities +"..."+ unit; }

# group: FamilyName, WorkMasterCode, Quantities, Unit 결합구간
name_3 = Element.Name(element=watch_3)
watch_material_index_6 = Watch(watch_material_index)
getItemAtIndex_6 = List.GetItemAtIndex(list=watch_material_index_6, index=flatten_3)
flatten_8 = List.Flatten(list=laceShortest_2)
watch_11 = Watch(flatten_8)
code_block_16 = CodeBlock { "M2"; }
code_block_17 = CodeBlock(familyName=name_3, workmasterCode=getItemAtIndex_6, quantities=watch_11, unit=code_block_16) { familyName +"..."+ workmasterCode +"..."+ quantities +"..."+ unit; }

# group: FamilyName, WorkMasterCode, Quantities, Unit 결합구간
name_4 = Element.Name(element=watch_5)
watch_material_index_7 = Watch(watch_material_index_2)
getItemAtIndex_7 = List.GetItemAtIndex(list=watch_material_index_7, index=flatten_4)
flatten_9 = List.Flatten(list=laceShortest_3)
watch_12 = Watch(flatten_9)
code_block_18 = CodeBlock { "M2"; }
code_block_19 = CodeBlock(familyName=name_4, workmasterCode=getItemAtIndex_7, quantities=watch_12, unit=code_block_18) { familyName +"..."+ workmasterCode +"..."+ quantities +"..."+ unit; }

# group: FamilyName, WorkMasterCode, Quantities, Unit 결합구간
name_5 = Element.Name(element=watch_9)
watch_material_index_8 = Watch(watch_material_index_2)
getItemAtIndex_8 = List.GetItemAtIndex(list=watch_material_index_8, index=flatten_6)
flatten_10 = List.Flatten(list=laceShortest_5)
watch_13 = Watch(flatten_10)
code_block_20 = CodeBlock { "M"; }
code_block_21 = CodeBlock(familyName=name_5, workmasterCode=getItemAtIndex_8, quantities=watch_13, unit=code_block_20) { familyName +"..."+ workmasterCode +"..."+ quantities/1000 +"..."+ unit; }

# group: DATA 전처리
join = List.Join(list0=code_block_15, list1=code_block_17, list2=code_block_19, list3=code_block_21)
code_block_22 = CodeBlock { "..."; }
split = String.Split(str=join, separator0=code_block_22)
watch_14 = Watch(split)

# group: Export Excel(By OpenpyXl)
python_script_export_excel_by = Python(IN[0]=watch_14)  # "Python Script@Export Excel(By OpenpyXl)"; CPython3; frozen
# ---------- python_script_export_excel_by.python (151 lines) ----------
# Load the Python Standard and DesignScript Libraries
import sys
import os
#sys.path.append(r'C:\Users\HEC\AppData\Local\Programs\Python\Python39\Lib\site-packages')
#sys.path.append(r'C:\Users\pjmk0\AppData\Local\Programs\Python\Python39\Lib\site-packages')
sys.path.append(os.getenv('LOCALAPPDATA').replace('\\','\\\\') + r'\Programs\Python\Python39\Lib\site-packages')
import clr
clr.AddReference('ProtoGeometry')
from Autodesk.DesignScript.Geometry import *
from collections import Iterable

def iterable(obj):
    return isinstance(obj, Iterable)


# The inputs to this node will be stored as a list in the IN variables.
dataEnteringNode = IN
ListIn = IN[0]

# Place your code below this line
import datetime
from datetime import date, timedelta
Today = date.today()
import openpyxl
from openpyxl.styles import Border, Side, PatternFill, Font, GradientFill, Alignment, Color, numbers

sample_items = ListIn


def write_to_file(filepath):
    wb = openpyxl.Workbook()
    for sheet in wb.sheetnames:
        wb.remove(wb[sheet])

    thin = Side(border_style="thin", color="000000")
    double = Side(border_style="double", color="000000")

    ws = wb.create_sheet(title='Wall_Calc_instance', index=0)

    ws.merge_cells('A1:L1')
    ws['A1'] = 'HEC Wall Category Calculation Sheet'
    cell = ws['A1']
    cell.font = openpyxl.styles.Font(color='000000', size=20)
    cell.fill = openpyxl.styles.fills.PatternFill(patternType='solid',
                                                  fgColor=openpyxl.styles.colors.Color(rgb='fff3b0'))

    ws['A2'] = 'Item Number'
    ws['A2'].font = openpyxl.styles.Font(b=True, color='000000', size=12)
    #ws['B2'] = 'Member Name'
    #ws['B2'].font = openpyxl.styles.Font(b=True, color='000000', size=12)
    #ws['C2'] = 'Category'
    #ws['C2'].font = openpyxl.styles.Font(b=True, color='000000', size=12)
    ws['B2'] = 'Family Type'
    ws['B2'].font = openpyxl.styles.Font(b=True, color='000000', size=12)
    ws['C2'] = 'WorkMaster Code'
    ws['C2'].font = openpyxl.styles.Font(b=True, color='000000', size=12)
    #ws['F2'] = 'WorkMaster Description'
    #ws['F2'].font = openpyxl.styles.Font(b=True, color='000000', size=12)
    #ws['G2'] = 'Unit'
    #ws['G2'].font = openpyxl.styles.Font(b=True, color='000000', size=12)
    #ws['H2'] = '계수'
    #ws['H2'].font = openpyxl.styles.Font(b=True, color='000000', size=12)
    #ws['I2'] = '계산 참조값'
    #ws['I2'].font = openpyxl.styles.Font(b=True, color='000000', size=12)
    ws['D2'] = 'Quantities'
    ws['D2'].font = openpyxl.styles.Font(b=True, color='000000', size=12)
    ws['E2'] = 'Unit'
    ws['E2'].font = openpyxl.styles.Font(b=True, color='000000', size=12)
    ws['F2'] = 'Unit Price'
    ws['F2'].font = openpyxl.styles.Font(b=True, color='000000', size=12)
    ws['G2'] = 'Total Price'
    ws['G2'].font = openpyxl.styles.Font(b=True, color='000000', size=12)


## 칼럼별 너비 조정 구간
#    for col in range(ws.max_column):
#        ws.column_dimensions[chr(ord('A') + col)].width = 15
    ws.column_dimensions['A'].width = 15
    ws.column_dimensions['B'].width = 45
    ws.column_dimensions['C'].width = 60
    ws.column_dimensions['D'].width = 20
    ws.column_dimensions['E'].width = 20
    ws.column_dimensions['F'].width = 20
    ws.column_dimensions['G'].width = 20
    #ws.column_dimensions['G'].width = 9
    #ws.column_dimensions['H'].width = 9
    #ws.column_dimensions['H'].hidden = True
    #ws.column_dimensions['I'].width = 12
    #ws.column_dimensions['I'].hidden = True
    #ws.column_dimensions['J'].width = 12
    #ws.column_dimensions['K'].width = 12
    #ws.column_dimensions['L'].width = 12

###
    start_row = 3
    for (row, item) in enumerate(sample_items, start_row):
        cell = ws.cell(row=row, column=1, value=row - 2)
        cell.alignment = openpyxl.styles.Alignment(horizontal='center', vertical='center')

#        cell = ws.cell(row=row, column=2, value=item[0])
#        cell.number_format = openpyxl.styles.numbers.FORMAT_DATE_YYYYMMDD2  # 'yyyy-mm-dd'
        ws.cell(row=row, column=2, value=item[0]) ## Family Type 칼럼

        ws.cell(row=row, column=3, value=item[1]) ## WorkMaster Code 칼럼
        
        ws.cell(row=row, column=4, value=item[2]) ## Quantities 칼럼
        
        ws.cell(row=row, column=5, value=item[3]) ## Unit 칼럼
        
        #cell = ws.cell(row=row, column=8, value=item[6]) ## 계수 칼럼
        #cell.number_format = openpyxl.styles.numbers.builtin_format_code(3)  # '#,##0'
        
        #cell = ws.cell(row=row, column=9, value=item[7]) ## 계산 참조값 칼럼
        #cell.number_format = openpyxl.styles.numbers.builtin_format_code(3)  # '#,##0'
        
        #cell = ws.cell(row=row, column=10, value=item[8]) ## Quantities 칼럼
        #cell.number_format = openpyxl.styles.numbers.builtin_format_code(3)  # '#,##0'
        #cell.font = openpyxl.styles.Font(b=True, color='000000', size=11)

        cell = ws.cell(row=row, column=7, value='= D{current_row}*F{current_row}'.format(current_row=cell.row))
        cell.number_format = '#,##0'

#        cell = ws.cell(row=row, column=6, value='= D{current_row} * E{current_row}'.format(current_row=cell.row))
#        cell.number_format = openpyxl.styles.numbers.builtin_format_code(3)

    total_row = ws.max_row + 1
    if total_row > start_row:
        cell1 = ws.cell(row=total_row, column=6, value='Total')
        cell1.font = openpyxl.styles.Font(b=True, color='000000', size=15)
        
        cell2 = ws.cell(row=total_row, column=7, value='= SUM(G{}:G{})'.format(start_row, total_row - 1))
        cell2.number_format = openpyxl.styles.numbers.builtin_format_code(3)
        cell2.border = Border(top=double, left=double, right=double, bottom=double)
        cell2.font = openpyxl.styles.Font(b=True, color='ff03ce', size=15)
    

    wb.save(filepath)
    wb.close()


##if __name__ == '__main__':
#write_to_file('C:\\Users\\pjmk0\\AppData\\Roaming\\test.xlsx')

save_name = "HEC_CalcSheet_Wall1_" + Today.strftime("%Y-%m-%d")+".xlsx"
path = os.getenv('APPDATA').replace('\\','\\\\')
filePath = path + '\\' + save_name

write_to_file(filePath)

# Assign your output to the OUT variable.
OUT = os.getenv('APPDATA')
# ----------------------------------------

# group: Excel Import
file_path = Filename("C:\Users\HEC\Desktop\통합 문서1.xlsx")  # frozen
file_from_path = FileObject(path=file_path)
string_from_object = FromObject(object=file_from_path)
code_block_23 = CodeBlock { "Scope_lv2(Walls)"; }
python_script_import_excel_by = Python(IN[0]=string_from_object, IN[1]=code_block_23)  # "Python Script@Import Excel(By OpenpyXl)"; CPython3
# ---------- python_script_import_excel_by.python (50 lines) ----------
# Load the Python Standard and DesignScript Libraries
import sys
import os
#sys.path.append(r'C:\Users\HEC\AppData\Local\Programs\Python\Python39\Lib\site-packages')
#sys.path.append(r'C:\Users\pjmk0\AppData\Local\Programs\Python\Python39\Lib\site-packages')
sys.path.append(os.getenv('LOCALAPPDATA').replace('\\','\\\\') + r'\Programs\Python\Python39\Lib\site-packages')
import clr
clr.AddReference('ProtoGeometry')
from Autodesk.DesignScript.Geometry import *
from collections import Iterable

def iterable(obj):
    return isinstance(obj, Iterable)


# The inputs to this node will be stored as a list in the IN variables.
dataEnteringNode = IN
PathIn = IN[0]
SheetNameIn = IN[1]

# Place your code below this line
import datetime
import openpyxl

path = (PathIn)
#path = (r'C:\Users\pjmk0\Downloads\MK\mQ\BIM_물량집계 자동화 산출기준표_rC(20210607)_mk_de.xlsx')

wb_obj = openpyxl.load_workbook(path, data_only=True)
sheet_obj = wb_obj.get_sheet_by_name(SheetNameIn)

m_row = sheet_obj.max_row
m_col = sheet_obj.max_column

listOut = []



for i in range(1, m_row +1):
    listTemp = []
    for j in range(1, m_col + 1):
        cell_obj = sheet_obj.cell(row=i, column=j)
        listTemp.append(cell_obj.value)
        if len(listTemp) == m_col:
            listOut.append(listTemp)
        


# Assign your output to the OUT variable.
OUT = listOut
#OUT = os.getenv('APPDATA')
# ----------------------------------------
code_block_24 = CodeBlock { false; }
importExcel = Data.ImportExcel(file=file_from_path, sheetName=code_block_23, showExcel=code_block_24)  # frozen

# group: Null값 처리
code_block_25 = CodeBlock { " "; }
isNull = Object.IsNull()  # unwired: object
replaceByCondition = Replace(item=python_script_import_excel_by, replaceWith=code_block_25, condition=isNull)

# group: Whole Data(Column direction)
transpose = List.Transpose(lists=replaceByCondition)
watch_15 = Watch(transpose)

# group: Row Index Guide
code_block_26 = CodeBlock(i=watch_15) { i[3]; }
watch_16 = Watch(code_block_26)

# group: Whole Data(row direction)
watch_17 = Watch(replaceByCondition)

# group: Column Index Guide
code_block_27 = CodeBlock(i=watch_17) { i[3]; }
watch_18 = Watch(code_block_27)

# group: All Elements of Category - WALLS
watch_all_elements_of_category = Watch(all_elements_of_category)  # "Watch@All Elements of Category - WALLS"; frozen

# group: 모델링에 사용된 모든 패밀리타입 코드 추출
elementType = Element.ElementType(element=watch_all_elements_of_category)
name_6 = Element.Name(element=elementType)
uniqueItems_2 = List.UniqueItems(list=name_6@L2)
flatten_11 = List.Flatten(list=uniqueItems_2)
watch_19 = Watch(flatten_11)
code_block_28 = CodeBlock { "_"; }
split_2 = String.Split(str=watch_19, separator0=code_block_28)
firstItem = List.FirstItem(list=split_2@L2)

# group: 사용된 패밀리타입이 위치한 Column Index 추출
string_from_object_2 = FromObject(object=watch_18)
contains_5 = String.Contains(searchFor=firstItem, lacing=CrossProduct)  # unwired: str
map_5 = List.Map(list=string_from_object_2, function=contains_5)
allFalse = List.AllFalse(list=map_5@L2)
code_block_29 = CodeBlock(i=allFalse) { i==false?true:false; }
code_block_30 = CodeBlock { true; }
allIndicesOf_5 = List.AllIndicesOf(list=code_block_29, item=code_block_30)

# group: 사용된 패밀리타입 Column Data 추출
watch_20 = Watch(allIndicesOf_5)
getItemAtIndex_9 = List.GetItemAtIndex(list=watch_15, index=watch_20)
watch_21 = Watch(getItemAtIndex_9)
code_block_31 = CodeBlock { 4; ""; }
# note: 불필요 정보 처리
replaceItemAtIndex = List.ReplaceItemAtIndex(list=getItemAtIndex_9@L2, index=code_block_31.out0, item=code_block_31.out1)

identity = Object.Identity(object=watch_17)

# group: D. Family Type
elementType_2 = Element.ElementType(element=watch_all_elements_of_category)
name_7 = Element.Name(element=elementType_2)

# group: C. Category
code_block_32 = CodeBlock { "Category"; }
getParameterValueByName_5 = Element.GetParameterValueByName(element=watch_all_elements_of_category, parameterName=code_block_32)

# group: 사용된 패밀리 타입에서 세부코드가 기입된 Row 열 번호 추출
string_from_object_3 = FromObject(object=replaceItemAtIndex)
code_block_33 = CodeBlock { "000"; }
contains_6 = String.Contains(str=string_from_object_3@L2, searchFor=code_block_33, lacing=CrossProduct)
code_block_34 = CodeBlock { true; }
allIndicesOf_6 = List.AllIndicesOf(list=contains_6@L2, item=code_block_34)
watch_22 = Watch(allIndicesOf_6)

# group: WM code 추출
identity_2 = Object.Identity(object=identity)
code_block_35 = CodeBlock(i=identity_2) { i[3]; }
watch_23 = Watch(code_block_35)
getItemAtIndex_10 = List.GetItemAtIndex(list=identity_2, index=watch_22@L2)
watch_24 = Watch(getItemAtIndex_10)
code_block_36 = CodeBlock { 2; }
getItemAtIndex_11 = List.GetItemAtIndex(list=watch_24@@L2, index=code_block_36)
watch_25 = Watch(getItemAtIndex_11)
code_block_37 = CodeBlock { 3; }
getItemAtIndex_12 = List.GetItemAtIndex(list=watch_24@@L2, index=code_block_37)
watch_26 = Watch(getItemAtIndex_12)
code_block_38 = CodeBlock { 4; }
getItemAtIndex_13 = List.GetItemAtIndex(list=watch_24@@L2, index=code_block_38)
watch_27 = Watch(getItemAtIndex_13)
watch_28 = Watch(replaceItemAtIndex)
code_block_39 = CodeBlock { 0; }
getItemAtIndex_14 = List.GetItemAtIndex(list=watch_24@@L2, index=code_block_39)
watch_29 = Watch(getItemAtIndex_14)
getItemAtIndex_15 = List.GetItemAtIndex(list=watch_28@@L2, index=watch_22@L2)
watch_30 = Watch(getItemAtIndex_15)
code_block_40 = CodeBlock(i=watch_29, j=watch_30) { i + "-" + j; }

# group: material inform from modeling <per element>
getMaterials_2 = Element.GetMaterials(element=watch_all_elements_of_category)
name_8 = Element.Name(element=getMaterials_2)
code_block_41 = CodeBlock { "_"; }
split_3 = String.Split(str=name_8, separator0=code_block_41)
firstItem_2 = List.FirstItem(list=split_3@L2)
count_10 = List.Count(list=getMaterials_2@L2)
chop = List.Chop(list=firstItem_2, lengths=count_10)

# group: Wall Type: WM Code 딕셔너리 생성(벽체 layer에 포함 되지 않은 WM code 까지 포함되어야함)
code_block_42 = CodeBlock { 3; }
getItemAtIndex_16 = List.GetItemAtIndex(list=watch_28@L2, index=code_block_42)
code_block_43 = CodeBlock { "_"; "-"; }
split_4 = String.Split(str=getItemAtIndex_16, separator0=code_block_43.out0, separator1=code_block_43.out1)
firstItem_3 = List.FirstItem(list=split_4@L2)
byKeysValues = DesignScript.Builtin.Dictionary.ByKeysValues(keys=firstItem_3, values=code_block_40)
watch_31 = Watch(byKeysValues)

# group: material inform from excel sheet <per family type>
watch_32 = Watch(watch_31)

# group: material inform from excel sheet <per element>
keys = DesignScript.Builtin.Dictionary.Keys(dictionary=watch_32)
name_9 = Element.Name(element=elementType_2)
contains_7 = String.Contains(str=name_9, searchFor=keys, lacing=CrossProduct)
code_block_44 = CodeBlock { true; }
allIndicesOf_7 = List.AllIndicesOf(list=contains_7@L2, item=code_block_44)
flatten_12 = List.Flatten(list=allIndicesOf_7)
getItemAtIndex_17 = List.GetItemAtIndex(list=keys, index=flatten_12)
valueAtKey = DesignScript.Builtin.Dictionary.ValueAtKey(dictionary=watch_32, key=getItemAtIndex_17)

# group: 합집합
add = _ + _  # unwired: x, y
code_block_45 = CodeBlock { "..."; }
add_2 = chop@L2 + code_block_45
combine = List.Combine(combineFunction=add, list0=add_2, list1=valueAtKey)
isNull_2 = Object.IsNull(object=combine)
anyTrue_5 = List.AnyTrue(list=isNull_2@L2)
code_block_46 = CodeBlock { true; }
allIndicesOf_8 = List.AllIndicesOf(list=anyTrue_5, item=code_block_46)
removeItemAtIndex = List.RemoveItemAtIndex(list=combine, indices=allIndicesOf_8)
code_block_47 = CodeBlock { "..."; }
split_5 = String.Split(str=removeItemAtIndex, separator0=code_block_47)
code_block_48 = CodeBlock { 1; }
flatten_13 = List.Flatten(list=split_5@L3, amt=code_block_48)

# group: WM 중복제거
uniqueItems_3 = List.UniqueItems(list=flatten_13@L2)

code_block_49 = CodeBlock {  }
code_block_50 = CodeBlock {  }
name_10 = Element.Name(element=getMaterials@L2)
