# Dynamo graph 20210604_column all, wall.floor, stairs(0622).dyn (Dynamo 2.6.1.8786)

# group: select all Category element
categories = Categories("OST_StructuralColumns")
all_elements_of_category = ElementsOfCategory()  # unwired: Category
code_block = CodeBlock { "Base Level"; }
parameterByName = Parameter.ParameterByName(element=all_elements_of_category, name=code_block)
string_from_object = FromObject(obj=parameterByName)
uniqueItems = List.UniqueItems(list=string_from_object)
code_block_2 = CodeBlock(i=string_from_object, j=uniqueItems) { i == j[0]; }
filterByBoolMask = List.FilterByBoolMask(list=all_elements_of_category, mask=code_block_2)

# group: 변수 확인 용
parameters = Element.Parameters(element=all_elements_of_category)
string_from_object_2 = FromObject(obj=parameters)
code_block_3 = CodeBlock(i=string_from_object_2) { i[0][6]; }

# group: 현재 카테고리 내에 적용될 Total WM code
file_path = Filename("..\dyn_test\wmCodeAll.xlsx")
file_from_path = FileObject()  # unwired: path
code_block_4 = CodeBlock { "wmCodeAll"; }
code_block_5 = CodeBlock { false; }
importExcel = Data.ImportExcel(file=file_from_path, sheetName=code_block_4, showExcel=code_block_5)
transpose = List.Transpose(lists=importExcel)
count = List.Count(list=transpose)
file_path_2 = Filename(".\1.txt")
code_block_6 = CodeBlock { "..."; }
code_block_7 = CodeBlock { " "; }
isNull = Object.IsNull()  # unwired: obj
replaceByCondition = Replace(item=transpose, replaceWith=code_block_7, condition=isNull)
code_block_8 = CodeBlock(i=replaceByCondition) { i[0]+"_"+i[1]+"_"+i[2]+"_"+i[3]; }
join = String.Join(separator=code_block_6, string0=code_block_8)
writeText = FileSystem.WriteText(filePath=file_path_2, text=join)
code_block_9 = CodeBlock(i=replaceByCondition) { i[0]; }
현재_카테고리_내에서_쓰일_total_wm_code = CodeBlock()
# ---------- 현재_카테고리_내에서_쓰일_total_wm_code.designscript (18 lines) ----------
i = [

"A03AC032",
"A03AC033",
"A03AC035",
"A03AC036",
"A03AC037",
"A03AE056",
"A03AE057",
"A03AE058",
"A03AE059",
"A03AE060",
"A03AE061",
"A03AH062",
"A03AH058",
"A03AH063"

];
# ----------------------------------------
indexOf = List.IndexOf(list=code_block_9, element=현재_카테고리_내에서_쓰일_total_wm_code)
getItemAtIndex = List.GetItemAtIndex(list=code_block_8, index=indexOf)  # frozen

현재_카테고리_내에서_쓰일_total_wm_full = CodeBlock(codeAll=getItemAtIndex) { codeAll; }  # "현재 카테고리 내에서 쓰일 Total WM full code"

# group: 거푸집 관련 WM 추출
현재_카테고리_내에서_쓰일_total_wm_code_2 = CodeBlock(codeAll=현재_카테고리_내에서_쓰일_total_wm_full) { codeAll; }
code_block_10 = CodeBlock()
# ---------- code_block_10.designscript (5 lines) ----------
[

"Form"

];
# ----------------------------------------
code_block_11 = CodeBlock(str=현재_카테고리_내에서_쓰일_total_wm_code_2, searchFor=code_block_10) { String.Contains(str<1>, searchFor, false); }
allFalse = List.AllFalse(list=code_block_11@L2)
code_block_12 = CodeBlock { false; }
allIndicesOf = List.AllIndicesOf(list=allFalse, item=code_block_12)
getItemAtIndex_2 = List.GetItemAtIndex(list=현재_카테고리_내에서_쓰일_total_wm_code_2, index=allIndicesOf)

watch = Watch(all_elements_of_category)
name = FamilyType.Name(familyType=watch)
watch_2 = Watch(name)
string_from_object_3 = FromObject(obj=watch_2)
code_block_13 = CodeBlock { "H-"; }
contains = String.Contains(str=string_from_object_3, searchFor=code_block_13)
filterByBoolMask_2 = List.FilterByBoolMask(list=all_elements_of_category, mask=contains)
watch_3 = Watch(filterByBoolMask_2.out)
code_block_14 = CodeBlock(i=watch_3) { i; }

# group: All faces
faces = Element.Faces(element=code_block_14)

# group: side face for A03AC035, A03AC036 (Form Work)
code_block_15 = CodeBlock { 0.5; }
normalAtParameter = Surface.NormalAtParameter(surface=faces, u=code_block_15, v=code_block_15)
Z = Vector.Z(vector=normalAtParameter)
code_block_16 = CodeBlock(i=Z) { i == 1 ||i == -1? false:true; }
filterByBoolMask_3 = List.FilterByBoolMask(list=faces, mask=code_block_16)

# group: calculation
area = Surface.Area(surface=filterByBoolMask_3.in)
code_block_17 = CodeBlock(num1=area) { num2 = Math.Sum(num1)/1000000; }

# group: instanace 별 wm 및 wm 물량값 매칭
code_block_18 = CodeBlock { "..."; }
join_2 = String.Join(separator=code_block_18)  # unwired: string0, string1
instance_별_계산값 = CodeBlock(i=code_block_17) { i; }
string_from_object_4 = FromObject(obj=instance_별_계산값)
cartesianProduct = List.CartesianProduct(comb=join_2, list1=getItemAtIndex_2, list2=string_from_object_4)
transpose_2 = List.Transpose(lists=cartesianProduct)

# group: 구체(RC) 관련 WM 추출
현재_카테고리_내에서_쓰일_total_wm_code_3 = CodeBlock(codeAll=현재_카테고리_내에서_쓰일_total_wm_full) { codeAll; }
code_block_19 = CodeBlock()
# ---------- code_block_19.designscript (6 lines) ----------
[

"Structural Concrete",
"Colored Concrete"

];
# ----------------------------------------
code_block_20 = CodeBlock(str=현재_카테고리_내에서_쓰일_total_wm_code_3, searchFor=code_block_19) { String.Contains(str<1>, searchFor, false); }
allFalse_2 = List.AllFalse(list=code_block_20@L2)
code_block_21 = CodeBlock { false; }
allIndicesOf_2 = List.AllIndicesOf(list=allFalse_2, item=code_block_21)
# note: 1 line text export
getItemAtIndex_3 = List.GetItemAtIndex(list=현재_카테고리_내에서_쓰일_total_wm_code_3, index=allIndicesOf_2)

# group: All solids
geometry = Element.Geometry(element=code_block_14)

# group: solids for A03AC032, A03AC033 (concrete)
solids_for_a03ac032_a03ac033 = CodeBlock(i=geometry) { i; }  # "solids for A03AC032, A03AC033 (concrete)"

# group: calculation
flatten = List.Flatten(list=solids_for_a03ac032_a03ac033)
code_block_22 = CodeBlock(i=flatten) { Solid.Volume(i)/1000000000; }

# group: instanace 별 wm 및 wm 물량값 매칭
code_block_23 = CodeBlock { "..."; }
join_3 = String.Join(separator=code_block_23)  # unwired: string0, string1
instance_별_계산값_2 = CodeBlock(i=code_block_22) { i; }
string_from_object_5 = FromObject(obj=instance_별_계산값_2)
cartesianProduct_2 = List.CartesianProduct(comb=join_3, list1=getItemAtIndex_3, list2=string_from_object_5)
transpose_3 = List.Transpose(lists=cartesianProduct_2)

# group: Protective Coating 관련 WM 추출
현재_카테고리_내에서_쓰일_total_wm_code_4 = CodeBlock(codeAll=현재_카테고리_내에서_쓰일_total_wm_full) { codeAll; }
code_block_24 = CodeBlock()
# ---------- code_block_24.designscript (5 lines) ----------
[

"Concrete Protective Coating (U/G)"

];
# ----------------------------------------
code_block_25 = CodeBlock(str=현재_카테고리_내에서_쓰일_total_wm_code_4, searchFor=code_block_24) { String.Contains(str<1>, searchFor, false); }
allFalse_3 = List.AllFalse(list=code_block_25@L2)
code_block_26 = CodeBlock { false; }
allIndicesOf_3 = List.AllIndicesOf(list=allFalse_3, item=code_block_26)
getItemAtIndex_4 = List.GetItemAtIndex(list=현재_카테고리_내에서_쓰일_total_wm_code_4, index=allIndicesOf_3)

# group: side face for A03AE056, A03AE057, A03AE058, A03AE059, A03AE060, A03AE061 (UG coating)
code_block_27 = CodeBlock { 0.5; }
normalAtParameter_2 = Surface.NormalAtParameter(surface=faces, u=code_block_27, v=code_block_27)
Z_2 = Vector.Z(vector=normalAtParameter_2)
code_block_28 = CodeBlock(i=Z_2) { i == 1 ||i == -1? false:true; }
filterByBoolMask_4 = List.FilterByBoolMask(list=faces, mask=code_block_28)

# group: calculation
area_2 = Surface.Area(surface=filterByBoolMask_4.in)
code_block_29 = CodeBlock(num1=area_2) { num2 = Math.Sum(num1)/1000000; }

# group: instanace 별 wm 및 wm 물량값 매칭
code_block_30 = CodeBlock { "..."; }
join_4 = String.Join(separator=code_block_30)  # unwired: string0, string1
instance_별_계산값_3 = CodeBlock(i=code_block_29) { i; }
string_from_object_6 = FromObject(obj=instance_별_계산값_3)
cartesianProduct_3 = List.CartesianProduct(comb=join_4, list1=getItemAtIndex_4, list2=string_from_object_6)
transpose_4 = List.Transpose(lists=cartesianProduct_3)

# group: export to excel
file_path_3 = Filename("C:\Users\HEC\Desktop\11.xlsx")
code_block_31 = CodeBlock { "Sheet1"; }
code_block_32 = CodeBlock { 1; }
code_block_33 = CodeBlock { true; }
exportExcel = Data.ExportExcel(filePath=file_path_3, sheetName=code_block_31, startRow=code_block_32, startCol=code_block_32, overWrite=code_block_33)  # unwired: data

현재_카테고리_내에서_쓰일_total_wm_full_2 = CodeBlock(codeAll=getItemAtIndex) { codeAll; }  # "현재 카테고리 내에서 쓰일 Total WM full code"

# group: 거푸집 관련 WM 추출
현재_카테고리_내에서_쓰일_total_wm_code_5 = CodeBlock(codeAll=현재_카테고리_내에서_쓰일_total_wm_full_2) { codeAll; }
code_block_34 = CodeBlock()  # same code as code_block_10
code_block_35 = CodeBlock(str=현재_카테고리_내에서_쓰일_total_wm_code_5, searchFor=code_block_34) { String.Contains(str<1>, searchFor, false); }
allFalse_4 = List.AllFalse(list=code_block_35@L2)
code_block_36 = CodeBlock { false; }
allIndicesOf_4 = List.AllIndicesOf(list=allFalse_4, item=code_block_36)
getItemAtIndex_5 = List.GetItemAtIndex(list=현재_카테고리_내에서_쓰일_total_wm_code_5, index=allIndicesOf_4)

watch_4 = Watch(filterByBoolMask_2.in)
code_block_37 = CodeBlock(o=watch_4) { o; }

# group: All faces
faces_2 = Element.Faces(element=code_block_37)

# group: side face for A03AC035, A03AC036 (Form Work)
code_block_38 = CodeBlock { 0.5; }
normalAtParameter_3 = Surface.NormalAtParameter(surface=faces_2, u=code_block_38, v=code_block_38)
Z_3 = Vector.Z(vector=normalAtParameter_3)
code_block_39 = CodeBlock(i=Z_3) { i == 1 ||i == -1? false:true; }
filterByBoolMask_5 = List.FilterByBoolMask(list=faces_2, mask=code_block_39)

# group: calculation
area_3 = Surface.Area(surface=filterByBoolMask_5.in)
code_block_40 = CodeBlock(num1=area_3) { num2 = Math.Sum(num1)/1000000; }

# group: instanace 별 wm 및 wm 물량값 매칭
code_block_41 = CodeBlock { "..."; }
join_5 = String.Join(separator=code_block_41)  # unwired: string0, string1
instance_별_계산값_4 = CodeBlock(i=code_block_40) { i; }
string_from_object_7 = FromObject(obj=instance_별_계산값_4)
cartesianProduct_4 = List.CartesianProduct(comb=join_5, list1=getItemAtIndex_5, list2=string_from_object_7)
transpose_5 = List.Transpose(lists=cartesianProduct_4)

# group: 구체(RC) 관련 WM 추출
현재_카테고리_내에서_쓰일_total_wm_code_6 = CodeBlock(codeAll=현재_카테고리_내에서_쓰일_total_wm_full_2) { codeAll; }
code_block_42 = CodeBlock()  # same code as code_block_19
code_block_43 = CodeBlock(str=현재_카테고리_내에서_쓰일_total_wm_code_6, searchFor=code_block_42) { String.Contains(str<1>, searchFor, false); }
allFalse_5 = List.AllFalse(list=code_block_43@L2)
code_block_44 = CodeBlock { false; }
allIndicesOf_5 = List.AllIndicesOf(list=allFalse_5, item=code_block_44)
getItemAtIndex_6 = List.GetItemAtIndex(list=현재_카테고리_내에서_쓰일_total_wm_code_6, index=allIndicesOf_5)

# group: All solids
geometry_2 = Element.Geometry(element=code_block_37)

# group: solids for A03AC032, A03AC033 (concrete)
solids_for_a03ac032_a03ac033_2 = CodeBlock(i=geometry_2) { i; }  # "solids for A03AC032, A03AC033 (concrete)"

# group: calculation
flatten_2 = List.Flatten(list=solids_for_a03ac032_a03ac033_2)
code_block_45 = CodeBlock(i=flatten_2) { Solid.Volume(i)/1000000000; }

# group: instanace 별 wm 및 wm 물량값 매칭
code_block_46 = CodeBlock { "..."; }
join_6 = String.Join(separator=code_block_46)  # unwired: string0, string1
instance_별_계산값_5 = CodeBlock(i=code_block_45) { i; }
string_from_object_8 = FromObject(obj=instance_별_계산값_5)
cartesianProduct_5 = List.CartesianProduct(comb=join_6, list1=getItemAtIndex_6, list2=string_from_object_8)
transpose_6 = List.Transpose(lists=cartesianProduct_5)

# group: Protective Coating 관련 WM 추출
현재_카테고리_내에서_쓰일_total_wm_code_7 = CodeBlock(codeAll=현재_카테고리_내에서_쓰일_total_wm_full_2) { codeAll; }
code_block_47 = CodeBlock()
# ---------- code_block_47.designscript (5 lines) ----------
[

"Concrete Protective Coating (A/G)"

];
# ----------------------------------------
code_block_48 = CodeBlock(str=현재_카테고리_내에서_쓰일_total_wm_code_7, searchFor=code_block_47) { String.Contains(str<1>, searchFor, false); }
allFalse_6 = List.AllFalse(list=code_block_48@L2)
code_block_49 = CodeBlock { false; }
allIndicesOf_6 = List.AllIndicesOf(list=allFalse_6, item=code_block_49)
getItemAtIndex_7 = List.GetItemAtIndex(list=현재_카테고리_내에서_쓰일_total_wm_code_7, index=allIndicesOf_6)

# group: side face for A03AE056, A03AE057, A03AE058, A03AE059, A03AE060, A03AE061 (UG coating)
code_block_50 = CodeBlock { 0.5; }
normalAtParameter_4 = Surface.NormalAtParameter(surface=faces_2, u=code_block_50, v=code_block_50)
Z_4 = Vector.Z(vector=normalAtParameter_4)
code_block_51 = CodeBlock(i=Z_4) { i == 1 ||i == -1? false:true; }
filterByBoolMask_6 = List.FilterByBoolMask(list=faces_2, mask=code_block_51)

# group: calculation
area_4 = Surface.Area(surface=filterByBoolMask_6.in)
code_block_52 = CodeBlock(num1=area_4) { num2 = Math.Sum(num1)/1000000; }

# group: instanace 별 wm 및 wm 물량값 매칭
code_block_53 = CodeBlock { "..."; }
join_7 = String.Join(separator=code_block_53)  # unwired: string0, string1
instance_별_계산값_6 = CodeBlock(i=code_block_52) { i; }
string_from_object_9 = FromObject(obj=instance_별_계산값_6)
cartesianProduct_6 = List.CartesianProduct(comb=join_7, list1=getItemAtIndex_7, list2=string_from_object_9)
transpose_7 = List.Transpose(lists=cartesianProduct_6)

code_block_54 = CodeBlock {  }
code_block_55 = CodeBlock {  }
code_block_56 = CodeBlock { "..."; }
join_8 = String.Join(separator=code_block_56)  # unwired: string0, string1

# group: 인스턴스 이름과 위치 정보
code_block_57 = CodeBlock(i=code_block_14) { i; }
code_block_58 = CodeBlock { "Type"; }
getParameterValueByName = Element.GetParameterValueByName(element=code_block_57, parameterName=code_block_58)
code_block_59 = CodeBlock { "Base Level"; }
getParameterValueByName_2 = Element.GetParameterValueByName(element=code_block_57, parameterName=code_block_59)
string_from_object_10 = FromObject(obj=getParameterValueByName_2)
code_block_60 = CodeBlock { ", "; }
split = String.Split(str=string_from_object_10, separator0=code_block_60)
code_block_61 = CodeBlock { -1; }
takeItems = List.TakeItems(list=split@L2, amount=code_block_61)
code_block_62 = CodeBlock(i=takeItems) { String.Length(i)-1; }
code_block_63 = CodeBlock { -1; }
remove = String.Remove(str=takeItems, startIndex=code_block_62, count=code_block_63)
flatten_3 = List.Flatten(list=remove)
code_block_64 = CodeBlock { "Column Location Mark"; }
getParameterValueByName_3 = Element.GetParameterValueByName(element=code_block_57, parameterName=code_block_64)
string_from_object_11 = FromObject(obj=getParameterValueByName_3)
code_block_65 = CodeBlock(i=getParameterValueByName, j=flatten_3, k=string_from_object_11) { i+"..."+j+"..."+k; }

code_block_66 = CodeBlock(i=code_block_65) { i; }
code_block_67 = CodeBlock(t1=cartesianProduct_2, t2=cartesianProduct, t3=cartesianProduct_3) { q = List.Join([t1<1>, t2<1>, t3<1>]); }
count_2 = List.Count(list=code_block_67)
python_script = Python(IN[0]=code_block_66, IN[1]=count_2)
# ---------- python_script.python (20 lines) ----------
# Load the Python Standard and DesignScript Libraries
import sys
import clr
clr.AddReference('ProtoGeometry')
from Autodesk.DesignScript.Geometry import *

# The inputs to this node will be stored as a list in the IN variables.
dataEnteringNode = IN
inputList = IN[0]
cycleCnt = IN[1]
outlist = []

# Place your code below this line

for i in inputList:
	for j in range(cycleCnt):
		outlist.append(i)

# Assign your output to the OUT variable.
OUT = outlist
# ----------------------------------------
transpose_8 = List.Transpose(lists=code_block_67)
flatten_4 = List.Flatten(list=transpose_8)
laceShortest = List.LaceShortest(comb=join_8, list1=python_script, list2=flatten_4)
code_block_68 = CodeBlock { "..."; }
split_2 = String.Split(str=laceShortest, separator0=code_block_68)
code_block_69 = CodeBlock { "..."; }
join_9 = String.Join(separator=code_block_69)  # unwired: string0, string1

# group: 인스턴스 이름과 위치 정보
code_block_70 = CodeBlock(i=code_block_37) { i; }
code_block_71 = CodeBlock { "Type"; }
getParameterValueByName_4 = Element.GetParameterValueByName(element=code_block_70, parameterName=code_block_71)
code_block_72 = CodeBlock { "Base Level"; }
getParameterValueByName_5 = Element.GetParameterValueByName(element=code_block_70, parameterName=code_block_72)
string_from_object_12 = FromObject(obj=getParameterValueByName_5)
code_block_73 = CodeBlock { ", "; }
split_3 = String.Split(str=string_from_object_12, separator0=code_block_73)
code_block_74 = CodeBlock { -1; }
takeItems_2 = List.TakeItems(list=split_3@L2, amount=code_block_74)
code_block_75 = CodeBlock(i=takeItems_2) { String.Length(i)-1; }
code_block_76 = CodeBlock { -1; }
remove_2 = String.Remove(str=takeItems_2, startIndex=code_block_75, count=code_block_76)
flatten_5 = List.Flatten(list=remove_2)
code_block_77 = CodeBlock { "Column Location Mark"; }
getParameterValueByName_6 = Element.GetParameterValueByName(element=code_block_70, parameterName=code_block_77)
string_from_object_13 = FromObject(obj=getParameterValueByName_6)
code_block_78 = CodeBlock(i=getParameterValueByName_4, j=flatten_5, k=string_from_object_13) { i+"..."+j+"..."+k; }

code_block_79 = CodeBlock(i=code_block_78) { i; }
code_block_80 = CodeBlock(t1=cartesianProduct_5, t2=cartesianProduct_4, t3=cartesianProduct_6) { q = List.Join([t1<1>, t2<1>, t3<1>]); }
count_3 = List.Count(list=code_block_80)
python_script_2 = Python(IN[0]=code_block_79, IN[1]=count_3)  # same code as python_script
transpose_9 = List.Transpose(lists=code_block_80)
flatten_6 = List.Flatten(list=transpose_9)
laceShortest_2 = List.LaceShortest(comb=join_9, list1=python_script_2, list2=flatten_6)
code_block_81 = CodeBlock { "..."; }
split_4 = String.Split(str=laceShortest_2, separator0=code_block_81)
join_10 = List.Join(list0=split_2, list1=split_4)

# group: select all Category element
categories_2 = Categories("OST_Walls")
all_elements_of_category_2 = ElementsOfCategory()  # unwired: Category
code_block_82 = CodeBlock { "Base Level"; "Base Constraint"; }
parameterByName_2 = Parameter.ParameterByName(element=all_elements_of_category_2, name=code_block_82.out1)
string_from_object_14 = FromObject(obj=parameterByName_2)
uniqueItems_2 = List.UniqueItems(list=string_from_object_14)
code_block_83 = CodeBlock(i=string_from_object_14, j=uniqueItems_2) { i == j[0]; }
filterByBoolMask_7 = List.FilterByBoolMask(list=all_elements_of_category_2, mask=code_block_83)

elementType = Element.ElementType()  # unwired: element
uniqueItems_3 = List.UniqueItems(list=elementType)
groupByFunction = List.GroupByFunction(list=all_elements_of_category_2, func=uniqueItems_3)
name_2 = Family.Name(family=groupByFunction)

# group: element-wm 별 면적 물량 추출 구간
getMaterials = Element.GetMaterials(element=groupByFunction)
code_block_84 = CodeBlock { "Area"; }
getParameterValueByName_7 = Element.GetParameterValueByName(element=groupByFunction, parameterName=code_block_84)
flatten_7 = List.Flatten(list=getParameterValueByName_7)
watch_5 = Watch(flatten_7)
count_4 = List.Count(list=getMaterials@L2)
ofRepeatedItem = List.OfRepeatedItem(item=watch_5, amount=count_4, lacing=Shortest)
flatten_8 = List.Flatten(list=ofRepeatedItem)

watch_6 = Watch(getMaterials)
name_3 = Material.Name(material=watch_6)
watch_7 = Watch(name_3)
flatten_9 = List.Flatten(list=watch_7)
watch_8 = Watch(flatten_9)

# group: input list 에서 대상문자열들 포함하는 index 추출
대상_문자열 = CodeBlock()
# ---------- 대상_문자열.designscript (5 lines) ----------
[

"PE Sheet"

];
# ----------------------------------------
code_block_85 = CodeBlock(str=flatten_9, searchFor=대상_문자열) { String.Contains(str<1>, searchFor, false); }
allFalse_7 = List.AllFalse(list=code_block_85@L2)
code_block_86 = CodeBlock { false; }
allIndicesOf_7 = List.AllIndicesOf(list=allFalse_7, item=code_block_86)

# group: element-wm 별 길이 물량 추출 구간
code_block_87 = CodeBlock { "Length"; }
getParameterValueByName_8 = Element.GetParameterValueByName(element=groupByFunction, parameterName=code_block_87)
flatten_10 = List.Flatten(list=getParameterValueByName_8)
watch_9 = Watch(flatten_10)
getMaterials_2 = Element.GetMaterials(element=groupByFunction)
count_5 = List.Count(list=getMaterials_2@L2)
ofRepeatedItem_2 = List.OfRepeatedItem(item=watch_9, amount=count_5, lacing=Shortest)
flatten_11 = List.Flatten(list=ofRepeatedItem_2)

watch_10 = Watch(flatten_11)

# group: element-wm 별 적합 물량 매칭 구간
watch_11 = Watch(flatten_8)
watch_12 = Watch(allIndicesOf_7)
getItemAtIndex_8 = List.GetItemAtIndex(list=watch_10, index=allIndicesOf_7)
watch_13 = Watch(getItemAtIndex_8)
code_block_88 = CodeBlock(inList=watch_11, replaceIndex=watch_12, replaceValue=watch_13)
# ---------- code_block_88.designscript (6 lines) ----------
numIndex = 0..List.Count(inList)-1;
numIndexDiffer = List.SetDifference(numIndex,replaceIndex);
numIndexFlatten = List.Flatten([numIndexDiffer,replaceIndex],-1);
bln1 = List.Contains(replaceIndex,numIndex<1>);
outList = List.FilterByBoolMask(inList,bln1);
outListFlatten = List.Flatten([outList["out"],replaceValue],-1);
# ----------------------------------------
sortByKey = List.SortByKey(list=code_block_88.outListFlatten, keys=code_block_88.numIndexFlatten)
watch_14 = Watch(sortByKey.sorted_list)

watch_15 = Watch(flatten_8)

# group: Wall
code_block_89 = CodeBlock {  }
code_block_90 = CodeBlock {  }

# group: Floors
code_block_91 = CodeBlock {  }
code_block_92 = CodeBlock {  }

# group: Str Columns
code_block_93 = CodeBlock {  }
code_block_94 = CodeBlock {  }

# group: select all Category element
categories_3 = Categories("OST_Floors")
all_elements_of_category_3 = ElementsOfCategory()  # unwired: Category
code_block_95 = CodeBlock { "Level"; }
parameterByName_3 = Parameter.ParameterByName(element=all_elements_of_category_3, name=code_block_95)
string_from_object_15 = FromObject(obj=parameterByName_3)
uniqueItems_4 = List.UniqueItems(list=string_from_object_15)
code_block_96 = CodeBlock(i=string_from_object_15, j=uniqueItems_4) { i == j[0]; }
filterByBoolMask_8 = List.FilterByBoolMask(list=all_elements_of_category_3, mask=code_block_96)

watch_16 = Watch(filterByBoolMask_8.in)
watch_17 = Watch(filterByBoolMask_8.out)

# group: edge 검토 후 진행 - Joint 할때
perimeterCurves = Surface.PerimeterCurves()  # unwired: surface
perimeterCurves_2 = Surface.PerimeterCurves()  # unwired: surface

# group: select all Category element
all_elements_of_category_4 = ElementsOfCategory()  # unwired: Category
code_block_97 = CodeBlock { "Level"; }
parameterByName_4 = Parameter.ParameterByName(element=all_elements_of_category_4, name=code_block_97)
string_from_object_16 = FromObject(obj=parameterByName_4)
uniqueItems_5 = List.UniqueItems(list=string_from_object_16)
code_block_98 = CodeBlock(i=string_from_object_16, j=uniqueItems_5) { i == j[0]; }
filterByBoolMask_9 = List.FilterByBoolMask(list=all_elements_of_category_4, mask=code_block_98)
categories_4 = Categories("OST_StructuralFoundation")

watch_18 = Watch(all_elements_of_category_4)
name_4 = FamilyType.Name(familyType=watch_18)
string_from_object_17 = FromObject(obj=name_4)
code_block_99 = CodeBlock { "FT112"; }
contains_2 = String.Contains(str=string_from_object_17, searchFor=code_block_99)
filterByBoolMask_10 = List.FilterByBoolMask(list=watch_18, mask=contains_2)
watch_19 = Watch(filterByBoolMask_10.in)

# group: All faces
faces_3 = Element.Faces(element=watch_19)

# group: 하부, 측부 Surface 추출 경사에 따라 Vector 값 범위 확정 필요 [ ] > 확정 후 하부, 측부 분리 > 분리 후 edge 추출 진행 > 분리 후 면적 총합 산출 진행
flatten_12 = List.Flatten(list=faces_3)
code_block_100 = CodeBlock { 0.5; }
normalAtParameter_5 = Surface.NormalAtParameter(surface=flatten_12, u=code_block_100, v=code_block_100)
Z_5 = Vector.Z(vector=normalAtParameter_5@L2)
code_block_101 = CodeBlock(a=Z_5) { a==0; }
filterByBoolMask_11 = List.FilterByBoolMask(list=flatten_12, mask=code_block_101@L2)
watch_20 = Watch(filterByBoolMask_11.in)
flatten_13 = List.Flatten(list=watch_20)
code_block_102 = CodeBlock(i=Z_5) { i == 1 ||i == -1? false:true; }
isAlmostEqualTo = Vector.IsAlmostEqualTo()  # unwired: vector, other
code_block_103 = CodeBlock(a=Z_5) { a<0; }
filterByBoolMask_12 = List.FilterByBoolMask(list=flatten_12, mask=code_block_103@L2)
# note: Surface 겹침 확인 필요 격자형
# 침
watch_21 = Watch(filterByBoolMask_12.in)
flatten_14 = List.Flatten(list=watch_21)

# group: edge 검토 후 진행
perimeterCurves_3 = Surface.PerimeterCurves(surface=flatten_13)
perimeterCurves_4 = Surface.PerimeterCurves(surface=flatten_14)

watch_22 = Watch(filterByBoolMask_9.in)
watch_23 = Watch(filterByBoolMask_9.out)

# group: Foundations
code_block_104 = CodeBlock {  }
code_block_105 = CodeBlock {  }

# group: Str Framing
code_block_106 = CodeBlock {  }
code_block_107 = CodeBlock {  }

# group: select all Category element
all_elements_of_category_5 = ElementsOfCategory()  # unwired: Category
code_block_108 = CodeBlock { "Reference Level"; }
parameterByName_5 = Parameter.ParameterByName(element=all_elements_of_category_5, name=code_block_108)
string_from_object_18 = FromObject(obj=parameterByName_5)
uniqueItems_6 = List.UniqueItems(list=string_from_object_18)
code_block_109 = CodeBlock(i=string_from_object_18, j=uniqueItems_6) { i == j[0]; }
filterByBoolMask_13 = List.FilterByBoolMask(list=all_elements_of_category_5, mask=code_block_109)
categories_5 = Categories("OST_StructuralFraming")

# group: Unit Weight 추출 전
watch_24 = Watch(all_elements_of_category_5)
code_block_110 = CodeBlock(a=watch_24) { a[0]; }
parameters_2 = Element.Parameters(element=code_block_110)
name_5 = Parameter.Name(parameter=parameters_2)
code_block_111 = CodeBlock { "Unit Weight"; "Weight"; "weight"; }
contains_3 = String.Contains(str=name_5, searchFor=code_block_111.out2)
countTrue = List.CountTrue(list=contains_3)
watch_25 = Watch(countTrue)
watch_26 = Watch()  # unwired: arg0

# group: Unit weight x element length
code_block_112 = CodeBlock { "Length"; }
getParameterValueByName_9 = Element.GetParameterValueByName(element=watch_24, parameterName=code_block_112)

code_block_113 = CodeBlock { UW; }  # unwired: UW
code_block_114 = CodeBlock { 90; 30; }
ge = code_block_113 >= code_block_114.out1
# note: Built up 자제만
watch_27 = Watch(ge)
# note: Built up 제외외
le = watch_27 <= code_block_114.out0
ge_2 = code_block_113 >= code_block_114.out0
lt = code_block_113 < code_block_114.out1
watch_28 = Watch(all_elements_of_category_5)
elementType_2 = Element.ElementType(element=watch_28)
familyName = ElementType.FamilyName(elementType=elementType_2)
watch_29 = Watch(familyName)
string_from_object_19 = FromObject(obj=watch_29)
code_block_115 = CodeBlock { "Concrete"; }
contains_4 = String.Contains(str=string_from_object_19, searchFor=code_block_115)
filterByBoolMask_14 = List.FilterByBoolMask(list=all_elements_of_category_5, mask=contains_4)
watch_30 = Watch(filterByBoolMask_14.out)
name_6 = FamilyType.Name(familyType=watch_30)
string_from_object_20 = FromObject(obj=name_6)
code_block_116 = CodeBlock { "BH-"; }
contains_5 = String.Contains(str=string_from_object_20, searchFor=code_block_116)
filterByBoolMask_15 = List.FilterByBoolMask(list=watch_30, mask=contains_5)
watch_31 = Watch(filterByBoolMask_15.out)
watch_32 = Watch(filterByBoolMask_14.in)

# group: surface
watch_33 = Watch(watch_31)
geometry_3 = Element.Geometry(element=watch_33)
watch_34 = Watch(geometry_3)
watch_35 = Watch(watch_32)
geometry_4 = Element.Geometry(element=watch_35)
watch_36 = Watch(geometry_4)
faces_4 = Element.Faces(element=watch_35)
faces_5 = Element.Faces(element=watch_33)

watch_37 = Watch(all_elements_of_category_3)

# group: All faces
faces_6 = Element.Faces(element=watch_37)

# group: 하부, 측부 Surface 추출 경사에 따라 Vector 값 범위 확정 필요 [ ] > 확정 후 하부, 측부 분리 > 분리 후 edge 추출 진행 > 분리 후 면적 총합 산출 진행
flatten_15 = List.Flatten(list=faces_6)
code_block_117 = CodeBlock { 0.5; }
normalAtParameter_6 = Surface.NormalAtParameter(surface=flatten_15, u=code_block_117, v=code_block_117)
Z_6 = Vector.Z(vector=normalAtParameter_6@L2)
code_block_118 = CodeBlock(i=Z_6) { i == 1 ||i == -1? false:true; }
code_block_119 = CodeBlock(a=Z_6) { a==0; }
code_block_120 = CodeBlock(a=Z_6) { a<0; }
filterByBoolMask_16 = List.FilterByBoolMask(list=flatten_15, mask=code_block_120@L2)
watch_38 = Watch(filterByBoolMask_16.in)
flatten_16 = List.Flatten(list=watch_38)
filterByBoolMask_17 = List.FilterByBoolMask(list=flatten_15, mask=code_block_119@L2)
watch_39 = Watch(filterByBoolMask_17.in)
flatten_17 = List.Flatten(list=watch_39)

code_block_121 = CodeBlock(a=Z_6) { a>0; }
filterByBoolMask_18 = List.FilterByBoolMask(list=flatten_15, mask=code_block_121@L2)
watch_40 = Watch(filterByBoolMask_18.in)
flatten_18 = List.Flatten(list=watch_40)
filterByBoolMask_19 = List.FilterByBoolMask(list=flatten_15, mask=code_block_118@L2)
watch_41 = Watch(filterByBoolMask_19.in)
flatten_19 = List.Flatten(list=watch_41)
countTrue_2 = List.CountTrue(list=code_block_118)
watch_42 = Watch(countTrue_2)
countTrue_3 = List.CountTrue(list=code_block_121)
watch_43 = Watch(countTrue_3)
countTrue_4 = List.CountTrue(list=code_block_119)
watch_44 = Watch(countTrue_4)
countTrue_5 = List.CountTrue(list=code_block_120)
watch_45 = Watch(countTrue_5)
setDifference = List.SetDifference(list1=flatten_16, list2=flatten_17)
code_block_122 = CodeBlock { 0.5; }
pointAtParameter = Surface.PointAtParameter(surface=flatten_17, u=code_block_122, v=code_block_122)
doesIntersect = Geometry.DoesIntersect(geometry=pointAtParameter, other=flatten_16, lacing=CrossProduct)
watch_46 = Watch(doesIntersect)
filterByBoolMask_20 = List.FilterByBoolMask(mask=watch_46@L2)  # unwired: list
flatten_20 = List.Flatten(list=filterByBoolMask_20.in)
watch_47 = Watch(flatten_17)
code_block_123 = CodeBlock { 2; }
round = Math.Round(number=Z_6, digits=code_block_123)
code_block_124 = CodeBlock(a=round) { a==0; a>0; a<0; }
filterByBoolMask_21 = List.FilterByBoolMask(list=flatten_15, mask=code_block_124.out2@L2)
watch_48 = Watch(filterByBoolMask_21.in)
flatten_21 = List.Flatten(list=watch_48)
# note: 하부 Surface
perimeterCurves_5 = Surface.PerimeterCurves(surface=flatten_21)
startPoint = Curve.StartPoint(curve=perimeterCurves_5)
boolean = BoolSelector(true)
byPoints = PolyCurve.ByPoints(points=startPoint, connectLastToFirst=boolean)
code_block_125 = CodeBlock { 100; }
offset = Curve.Offset(curve=byPoints, distance=code_block_125)
ZAxis = Vector.ZAxis()
Z_7 = Vector.Z(vector=ZAxis)
watch_49 = Watch(Z_7)
code_block_126 = CodeBlock(z=watch_49) { z>0; }
reverse = Vector.Reverse(vector=ZAxis)
if_ = If(test=code_block_126, true=reverse, false=ZAxis)
code_block_127 = CodeBlock { 1000; }
extrudeAsSolid = Curve.ExtrudeAsSolid(curve=offset, direction=if_, distance=code_block_127)
watch_50 = Watch(reverse)
flatten_22 = List.Flatten(list=flatten_21)
area_5 = Surface.Area(surface=flatten_22)
sum = Math.Sum(values=area_5)
watch_51 = Watch(sum)
code_block_128 = CodeBlock { 2; }
round_2 = Math.Round(number=Z_5, digits=code_block_128)
code_block_129 = CodeBlock(a=round_2) { a==0; a>0; a<0; a==-1; }
filterByBoolMask_22 = List.FilterByBoolMask(list=flatten_12, mask=code_block_129.out3@L2)
watch_52 = Watch(filterByBoolMask_22.in)
flatten_23 = List.Flatten(list=watch_52)
byGeometry = BoundingBox.ByGeometry(geom=flatten_23)
toCuboid = BoundingBox.ToCuboid(boundingBox=byGeometry)
explode = Geometry.Explode(geometry=toCuboid)
perimeterCurves_6 = Surface.PerimeterCurves(surface=explode)
startPoint_2 = Curve.StartPoint(curve=perimeterCurves_6)

# group: 독립 기초용 따로 만들어야함
boolean_2 = BoolSelector(true)
byPoints_2 = PolyCurve.ByPoints(points=startPoint_2, connectLastToFirst=boolean_2)
code_block_130 = CodeBlock { 100; }
offset_2 = Curve.Offset(curve=byPoints_2, distance=code_block_130)
code_block_131 = CodeBlock { 700; }
offset_3 = Curve.Offset(curve=byPoints_2, distance=code_block_131)
ZAxis_2 = Vector.ZAxis()
code_block_132 = CodeBlock { 1000; }
translate = Geometry.Translate(geometry=offset_3, direction=ZAxis_2, distance=code_block_132)
join_11 = List.Join(list0=offset_2, list1=translate)
byLoft = Solid.ByLoft(crossSections=join_11)
code_block_133 = CodeBlock { 100; }
byARGB = Color.ByARGB(a=code_block_133, r=code_block_133)
byGeometryColor = Modifiers.GeometryColor.ByGeometryColor(geometry=byLoft, color=byARGB)

perimeterCurves_7 = Surface.PerimeterCurves(surface=flatten_23)
startPoint_3 = Curve.StartPoint(curve=perimeterCurves_7)
boolean_3 = BoolSelector(true)
byPoints_3 = PolyCurve.ByPoints(points=startPoint_3, connectLastToFirst=boolean_3)
code_block_134 = CodeBlock { 100; }
offset_4 = Curve.Offset(curve=byPoints_3, distance=code_block_134)
code_block_135 = CodeBlock { 0.5; }
normalAtParameter_7 = Surface.NormalAtParameter(surface=flatten_23, u=code_block_135, v=code_block_135)
Z_8 = Vector.Z(vector=normalAtParameter_7)
watch_53 = Watch(Z_8)
code_block_136 = CodeBlock(z=watch_53) { z>0; }
reverse_2 = Vector.Reverse(vector=normalAtParameter_7)
if_2 = If(test=code_block_136, true=reverse_2, false=normalAtParameter_7)
code_block_137 = CodeBlock { 400; }
extrudeAsSolid_2 = Curve.ExtrudeAsSolid(curve=offset_4, direction=if_2, distance=code_block_137)
explode_2 = Geometry.Explode(geometry=extrudeAsSolid_2)
flatten_24 = List.Flatten(list=explode_2)
code_block_138 = CodeBlock { 0.5; }
normalAtParameter_8 = Surface.NormalAtParameter(surface=flatten_24, u=code_block_138, v=code_block_138)
Z_9 = Vector.Z(vector=normalAtParameter_8@L2)
code_block_139 = CodeBlock { 2; }
round_3 = Math.Round(number=Z_9, digits=code_block_139)
code_block_140 = CodeBlock(a=round_3) { a==0; a>0; a<0; }
filterByBoolMask_23 = List.FilterByBoolMask(list=flatten_24, mask=code_block_140.out2@L2)
flatten_25 = List.Flatten(list=filterByBoolMask_23.in)
perimeterCurves_8 = Surface.PerimeterCurves(surface=flatten_25)
startPoint_4 = Curve.StartPoint(curve=perimeterCurves_8)
boolean_4 = BoolSelector(true)
byPoints_4 = PolyCurve.ByPoints(points=startPoint_4, connectLastToFirst=boolean_4)
code_block_141 = CodeBlock { 100; }
offset_5 = Curve.Offset(curve=byPoints_4, distance=code_block_141)
code_block_142 = CodeBlock { 0.5; }
normalAtParameter_9 = Surface.NormalAtParameter(surface=flatten_25, u=code_block_142, v=code_block_142)
Z_10 = Vector.Z(vector=normalAtParameter_9)
watch_54 = Watch(Z_10)
code_block_143 = CodeBlock(z=watch_54) { z>0; }
reverse_3 = Vector.Reverse(vector=normalAtParameter_9)
if_3 = If(test=code_block_143, true=reverse_3, false=normalAtParameter_9)
code_block_144 = CodeBlock { 200; }
extrudeAsSolid_3 = Curve.ExtrudeAsSolid(curve=offset_5, direction=if_3, distance=code_block_144)
watch_55 = Watch(byLoft)
volume = Solid.Volume(solid=watch_55)
categories_6 = Categories("OST_StructuralFraming")
all_elements_of_category_6 = ElementsOfCategory(Category=categories_6)
geometry_5 = Element.Geometry(element=all_elements_of_category_6)
categories_7 = Categories("OST_StructuralColumns")
all_elements_of_category_7 = ElementsOfCategory(Category=categories_7)
geometry_6 = Element.Geometry(element=all_elements_of_category_7)
geometry_7 = Element.Geometry(element=all_elements_of_category_4)
list_create = List.Create(item0=geometry_5, item1=geometry_6, item2=geometry_7)
flatten_26 = List.Flatten(list=list_create)
byUnion = Solid.ByUnion(solids=flatten_26)
intersect = Geometry.Intersect(geometry=watch_55, other=byUnion)
volume_2 = Solid.Volume(solid=intersect)
sub = volume - volume_2
watch_56 = Watch(sub)
geometry_8 = Element.Geometry()  # unwired: element
geometry_9 = Element.Geometry(element=watch_3)

# group: Volume 검토
volume_3 = Solid.Volume(solid=geometry)
watch_57 = Watch(volume_3)
code_block_145 = CodeBlock { "Volume"; }
getParameterValueByName_10 = Element.GetParameterValueByName(element=code_block_14, parameterName=code_block_145)
watch_58 = Watch(getParameterValueByName_10)

# group: con'c ratio x
code_block_146 = CodeBlock(a=watch_58) { a*0.1; }
watch_59 = Watch(code_block_146)

# group: con'c ratio x
code_block_147 = CodeBlock { a*0.1; }  # unwired: a
watch_60 = Watch(code_block_147)

elementType_3 = Element.ElementType(element=code_block_37)

# group: Volume 검토
volume_4 = Solid.Volume(solid=geometry_2)
watch_61 = Watch(volume_4)
code_block_148 = CodeBlock { "Unit Weight"; }
getParameterValueByName_11 = Element.GetParameterValueByName(element=elementType_3, parameterName=code_block_148)
watch_62 = Watch(getParameterValueByName_11)

# group: 조금더 많은 element sample에서 test 30<a<90 관련 풀이 확인 후 적용
code_block_149 = CodeBlock(a=watch_62) { a>90; a<30; }
watch_63 = Watch(code_block_149.out1)
watch_64 = Watch(code_block_149.out0)
filterByBoolMask_24 = List.FilterByBoolMask(list=code_block_37, mask=watch_64)

# group: Base Plate 모델링 추가분 sample 에서 test
code_block_150 = CodeBlock {  }

# group: All solids
geometry_10 = Element.Geometry(element=code_block_37)

explode_3 = Geometry.Explode(geometry=geometry_10)
flatten_27 = List.Flatten(list=explode_3)
code_block_151 = CodeBlock { 0.5; }
normalAtParameter_10 = Surface.NormalAtParameter(surface=flatten_27, u=code_block_151, v=code_block_151)
Z_11 = Vector.Z(vector=normalAtParameter_10@L2)
code_block_152 = CodeBlock { 2; }
round_4 = Math.Round(number=Z_11, digits=code_block_152)
code_block_153 = CodeBlock(a=round_4) { a==0; a>0; a<0; a==-1; }
filterByBoolMask_25 = List.FilterByBoolMask(list=flatten_27, mask=code_block_153.out1@L2)
flatten_28 = List.Flatten(list=filterByBoolMask_25.in)
byGeometry_2 = BoundingBox.ByGeometry(geom=flatten_28@L1)
toCuboid_2 = BoundingBox.ToCuboid(boundingBox=byGeometry_2)
explode_4 = Geometry.Explode(geometry=toCuboid_2)
perimeterCurves_9 = Surface.PerimeterCurves(surface=explode_4)
startPoint_5 = Curve.StartPoint(curve=perimeterCurves_9)
boolean_5 = BoolSelector(true)
byPoints_5 = PolyCurve.ByPoints(points=startPoint_5, connectLastToFirst=boolean_5)
code_block_154 = CodeBlock { 50; }
offset_6 = Curve.Offset(curve=byPoints_5, distance=code_block_154)
ZAxis_3 = Vector.ZAxis()
reverse_4 = Vector.Reverse(vector=ZAxis_3)
code_block_155 = CodeBlock { "Length"; }
getParameterValueByName_12 = Element.GetParameterValueByName(element=code_block_37, parameterName=code_block_155)
watch_65 = Watch(getParameterValueByName_12)
extrudeAsSolid_4 = Curve.ExtrudeAsSolid(curve=offset_6, direction=reverse_4, distance=watch_65)
watch_66 = Watch(extrudeAsSolid_4)
watch_67 = Watch(geometry_10)
differenceAll = Solid.DifferenceAll(solid=watch_66, others=watch_67, lacing=Shortest)
volume_5 = Solid.Volume(solid=differenceAll)
watch_68 = Watch(volume_5)
flatten_29 = List.Flatten(list=filterByBoolMask_25.in)
perimeterCurves_10 = Surface.PerimeterCurves(surface=flatten_29)
startPoint_6 = Curve.StartPoint(curve=perimeterCurves_10)
boolean_6 = BoolSelector(true)
byPoints_6 = PolyCurve.ByPoints(points=startPoint_6, connectLastToFirst=boolean_6)
code_block_156 = CodeBlock { 0; }
offset_7 = Curve.Offset(curve=byPoints_6, distance=code_block_156)

# group: 접한 요소와의 공재 범위 확인 필요
ZAxis_4 = Vector.ZAxis()
reverse_5 = Vector.Reverse(vector=ZAxis_4)
extrudeAsSolid_5 = Curve.ExtrudeAsSolid(curve=offset_7, direction=reverse_5, distance=watch_65)
area_6 = Solid.Area(solid=extrudeAsSolid_5)
extrude = Curve.Extrude(curve=offset_7, direction=reverse_5, distance=watch_65)
area_7 = Surface.Area(surface=extrude)

# note: Built up
watch_69 = Watch(filterByBoolMask_15.in)
flatten_30 = List.Flatten(list=faces_4)
flatten_31 = List.Flatten(list=faces_5)
area_8 = Surface.Area()  # unwired: surface
area_9 = Surface.Area()  # unwired: surface

# group: Stair
code_block_157 = CodeBlock {  }
code_block_158 = CodeBlock {  }

# group: select all Category element
categories_8 = Categories("OST_Stairs")
all_elements_of_category_8 = ElementsOfCategory(Category=categories_8)
code_block_159 = CodeBlock { "Run Type"; }

elementType_4 = Element.ElementType(element=all_elements_of_category_8)

# group (continued): select all Category element
parameterByName_6 = Parameter.ParameterByName(element=elementType_4, name=code_block_159)
string_from_object_21 = FromObject(obj=parameterByName_6)
uniqueItems_7 = List.UniqueItems(list=string_from_object_21)
code_block_160 = CodeBlock(i=string_from_object_21, j=uniqueItems_7) { i == j[0]; }
filterByBoolMask_26 = List.FilterByBoolMask(list=all_elements_of_category_8, mask=code_block_160)

name_7 = Element.Name(element=all_elements_of_category_8)
familyName_2 = ElementType.FamilyName(elementType=elementType_4)
name_8 = Family.Name(family=all_elements_of_category_8)
family = FamilyType.Family(familyType=all_elements_of_category_8)
getParameterValueByName_13 = Element.GetParameterValueByName(element=elementType_4, parameterName=code_block_159)
watch_70 = Watch(getParameterValueByName_13)
name_9 = Element.Name(element=watch_70)
watch_71 = Watch(name_9)
code_block_161 = CodeBlock { "콘크리트"; }
eq = watch_71 == code_block_161
filterByBoolMask_27 = List.FilterByBoolMask(list=all_elements_of_category_8, mask=eq)
콘크리 = Watch(filterByBoolMask_27.in)
geometry_11 = Element.Geometry(element=콘크리)
watch_72 = Watch(geometry_11)
flatten_32 = List.Flatten(list=watch_72)
explode_5 = Geometry.Explode(geometry=flatten_32)
watch_73 = Watch(explode_5)
철골 = Watch(filterByBoolMask_27.out)
geometry_12 = Element.Geometry(element=철골)
watch_74 = Watch(geometry_12)
flatten_33 = List.Flatten(list=watch_74)
explode_6 = Geometry.Explode(geometry=flatten_33)
watch_75 = Watch(explode_6)
code_block_162 = CodeBlock(a=flatten_33) { a[2]; }
explode_7 = Geometry.Explode(geometry=code_block_162)
watch_76 = Watch(explode_7)
centroid = Solid.Centroid(solid=code_block_162)
boundingBox = Geometry.BoundingBox(geometry=code_block_162)
toCuboid_3 = BoundingBox.ToCuboid(boundingBox=boundingBox)
code_block_163 = CodeBlock { 100; }
byARGB_2 = Color.ByARGB(a=code_block_163, r=code_block_163)
byGeometryColor_2 = Modifiers.GeometryColor.ByGeometryColor(geometry=toCuboid_3, color=byARGB_2)
minPoint = BoundingBox.MinPoint(boundingBox=boundingBox)
watch_77 = Watch(minPoint)
Y = Point.Y(point=watch_77)
Z_12 = Point.Z(point=watch_77)
maxPoint = BoundingBox.MaxPoint(boundingBox=boundingBox)
watch_78 = Watch(maxPoint)
X = Point.X(point=watch_78)
X_2 = Point.X(point=watch_77)
Y_2 = Point.Y(point=watch_78)
Z_13 = Point.Z(point=watch_78)
byCoordinates = Point.ByCoordinates(x=X_2, y=Y_2, z=Z_13)
byStartPointEndPoint = Line.ByStartPointEndPoint(startPoint=watch_77, endPoint=byCoordinates)
explode_8 = Geometry.Explode(geometry=toCuboid_3)
pointAtParameter_2 = Surface.PointAtParameter(surface=explode_8)
code_block_164 = CodeBlock { 1; }
pointAtParameter_3 = Surface.PointAtParameter(surface=explode_8, u=code_block_164, v=code_block_164)
byStartPointEndPoint_2 = Line.ByStartPointEndPoint(startPoint=pointAtParameter_2, endPoint=pointAtParameter_3)
length = Curve.Length()  # unwired: curve
maximumItemByKey = List.MaximumItemByKey(list=byStartPointEndPoint_2, keyProjector=length)
boundingBox_2 = Geometry.BoundingBox(geometry=flatten_32)
toCuboid_4 = BoundingBox.ToCuboid(boundingBox=boundingBox_2)
volume_6 = Solid.Volume(solid=toCuboid_4)
watch_79 = Watch(volume_6)
code_block_165 = CodeBlock(a=watch_79) { a[0]; }
gt = watch_79 > code_block_165
filterByBoolMask_28 = List.FilterByBoolMask(list=toCuboid_4, mask=gt)
explode_9 = Geometry.Explode(geometry=filterByBoolMask_28.in)
pointAtParameter_4 = Surface.PointAtParameter(surface=explode_9)
code_block_166 = CodeBlock { 1; }
pointAtParameter_5 = Surface.PointAtParameter(surface=explode_9, u=code_block_166, v=code_block_166)
byStartPointEndPoint_3 = Line.ByStartPointEndPoint(startPoint=pointAtParameter_4, endPoint=pointAtParameter_5)
length_2 = Curve.Length()  # unwired: curve
maximumItemByKey_2 = List.MaximumItemByKey(list=byStartPointEndPoint_3@L2, keyProjector=length_2)
watch_80 = Watch(filterByBoolMask_28.out)
explode_10 = Geometry.Explode(geometry=watch_80)
flatten_34 = List.Flatten(list=explode_10)
area_10 = Surface.Area()  # unwired: surface
maximumItemByKey_3 = List.MaximumItemByKey(list=flatten_34@L2, keyProjector=area_10)
perimeterCurves_11 = Surface.PerimeterCurves(surface=maximumItemByKey_3)
flatten_35 = List.Flatten(list=perimeterCurves_11)
length_3 = Curve.Length()  # unwired: curve
minimumItemByKey = List.MinimumItemByKey(list=flatten_35, keyProjector=length_3)
code_block_167 = CodeBlock { 2; }
ofRepeatedItem_3 = List.OfRepeatedItem(item=minimumItemByKey, amount=code_block_167)
maximumItemByKey_4 = List.MaximumItemByKey(list=flatten_35, keyProjector=length_3)
join_12 = List.Join(list0=maximumItemByKey_2, list1=ofRepeatedItem_3, list2=maximumItemByKey_4)
watch_81 = Watch(join_12)
length_4 = Curve.Length(curve=watch_81)
sum_2 = Math.Sum(values=length_4)

# group: Line 길이
code_block_168 = CodeBlock {  }
code_block_169 = CodeBlock {  }

# group: Line 길이
code_block_170 = CodeBlock {  }
code_block_171 = CodeBlock {  }

count_6 = List.Count(list=geometry_12@L2)
code_block_172 = CodeBlock(a=count_6) { a>4; }
filterByBoolMask_29 = List.FilterByBoolMask(list=watch_74, mask=code_block_172)
watch_82 = Watch(filterByBoolMask_29.in)
flatten_36 = List.Flatten(list=watch_82)
explode_11 = Geometry.Explode(geometry=flatten_36)
flatten_37 = List.Flatten(list=explode_11)
code_block_173 = CodeBlock { 0.5; }
normalAtParameter_11 = Surface.NormalAtParameter(surface=explode_11, u=code_block_173, v=code_block_173)
Z_14 = Vector.Z(vector=normalAtParameter_11)
code_block_174 = CodeBlock { 1; }
round_5 = Math.Round(number=Z_14, digits=code_block_174)
flatten_38 = List.Flatten(list=round_5)
code_block_175 = CodeBlock(a=flatten_38) { a==0; }
filterByBoolMask_30 = List.FilterByBoolMask(list=flatten_37, mask=code_block_175)
flatten_39 = List.Flatten(list=filterByBoolMask_30.out)
