# Dynamo graph 요청자료.dyn (Dynamo 2.3.0.5885)

select_model_elements = DSModelElementsSelection()  # 1 picked in the model
code_block = CodeBlock { "a"; "b"; "c"; "d"; "e"; "f"; }
join = List.Join(list0=code_block.out0, list1=code_block.out1, list2=code_block.out2, list3=code_block.out3, list4=code_block.out4, list5=code_block.out5)
code_block_2 = CodeBlock { 91.66666667; 93.26923077; 94.87179487; 96.47435897; 98.07692308; 99.13782051; }
join_2 = List.Join(list0=code_block_2.out0, list1=code_block_2.out1, list2=code_block_2.out2, list3=code_block_2.out3, list4=code_block_2.out4, list5=code_block_2.out5)
code_block_3 = CodeBlock(x=join_2) { Math.Round(Math.Atan((x)/100),4); }
setParameterByName = Element.SetParameterByName(element=select_model_elements, parameterName=join, value=code_block_3)
