# Dynamo graph 벽 구분.dyn (Dynamo 2.12.0.5650)

categories = Categories("OST_Walls")
all_elements_of_category = ElementsOfCategory(Category=categories)

# group: 벽체 위치선 얻어오기
getLocation = Element.GetLocation(element=all_elements_of_category)

# group: 서로 접하는 벽체 라인 찾아내기
findGroups = Python(IN[0]=getLocation)  # IronPython2
# ---------- findGroups.python (36 lines) ----------
# Load the Python Standard and DesignScript Libraries
import sys
import clr
clr.AddReference('ProtoGeometry')
from Autodesk.DesignScript.Geometry import *

# The inputs to this node will be stored as a list in the IN variables.
dataEnteringNode = IN
lines = IN[0]

# Place your code below this line

def findGroups(lines):
	result = []
	idxlog = []
	
	for i in range(len(lines)):
		tmp1 = []
		if i in idxlog:
			pass
		else:
			idxlog.append(i)
			tmp1.append(lines[i])
			for j in range(len(lines)):
				if j in idxlog:
					pass
				else:
					target = PolyCurve.ByJoinedCurves(tmp1)
					if target.DoesIntersect(lines[j]):
						idxlog.append(j)
						tmp1.append(lines[j])
			result.append(tmp1)
	return result

# Assign your output to the OUT variable.
OUT = findGroups(lines)
# ----------------------------------------
byJoinedCurves = PolyCurve.ByJoinedCurves(curves=findGroups)

# group: 벽 선분들 시계방향 여부 판별 하여 반시계방향인 그룹 찾아내기
시계방향여부_판별 = Python(IN[0]=findGroups)  # IronPython2
# ---------- 시계방향여부_판별.python (27 lines) ----------
# Load the Python Standard and DesignScript Libraries
import sys
import clr
clr.AddReference('ProtoGeometry')
from Autodesk.DesignScript.Geometry import *

# The inputs to this node will be stored as a list in the IN variables.
dataEnteringNode = IN
crvGroups = IN[0]

# Place your code below this line
def ccw(crvs):
	crv1 = crvs[0]
	crv2 = crvs[1]
	A = crv1.StartPoint
	B = crv1.EndPoint
	C = crv2.EndPoint
	외적 = (B.X - A.X)*(C.Y - A.Y) - (C.X - A.X)*(B.Y - A.Y)
	
	if 외적>0:
		return "CCW"
	elif 외적<0:
		return "CW"
		
result = [ccw(crvs) for crvs in crvGroups]
# Assign your output to the OUT variable.
OUT = result
# ----------------------------------------
code_block = CodeBlock(i=시계방향여부_판별) { i=="CCW"; }
filterByBoolMask = List.FilterByBoolMask(list=findGroups, mask=code_block)
code_block_2 = CodeBlock(i=filterByBoolMask.in) { i[0]; }

reverse = Curve.Reverse(curve=code_block_2)
