# Dynamo graph A+B.dyn (Dynamo 2.13.1.3887)

code_block = CodeBlock { 1; 2; }
check_starttime = Python(IN[0]=code_block.out0)  # CPython3
# ---------- check_starttime.python (21 lines) ----------
# Load the Python Standard and DesignScript Libraries
import sys
import clr
clr.AddReference('ProtoGeometry')
from Autodesk.DesignScript.Geometry import *
import time

# The inputs to this node will be stored as a list in the IN variables.
dataEnteringNode = IN
startPoint = IN[0]

# Place your code below this line
def chk_startTime(startPoint):
    if startPoint != []:
        start = time.time()
    else:
        start = []
    return start

# Assign your output to the OUT variable.
OUT = chk_startTime(startPoint)
# ----------------------------------------
add = code_block.out0 + code_block.out1
calcualte_executiontime = Python(IN[0]=check_starttime, IN[1]=add)  # CPython3
# ---------- calcualte_executiontime.python (27 lines) ----------
# Load the Python Standard and DesignScript Libraries
import sys
import clr
clr.AddReference('ProtoGeometry')
from Autodesk.DesignScript.Geometry import *
import time

# The inputs to this node will be stored as a list in the IN variables.
dataEnteringNode = IN

def calc_exeTime(startTime, algo_result):
    if algo_result != []:
        endTime = time.time()
        exeTime = endTime - startTime
    return exeTime * 1000
    
def printExeTime(time):
    resStr = ' '.join([str(round(time, 3)), "ms"])
    return resStr

# Place your code below this line
startTime = IN[0]
    
algo_result = IN[1]

# Assign your output to the OUT variable.
OUT = printExeTime(calc_exeTime(startTime, algo_result))
# ----------------------------------------
