# Dynamo graph ACM 호텔.dyn (Dynamo 2.13.1.3887)

code_block = CodeBlock { 2; "6 12 10"; "30 50 72"; }
join = List.Join(list0=code_block.out0, list1=code_block.out1, list2=code_block.out2)
deconstruct = List.Deconstruct(list=join)
code_block_2 = CodeBlock { " "; }
split = String.Split(string=deconstruct.rest, separator0=code_block_2)
toNumber = String.ToNumber(string=split)
deconstruct_2 = List.Deconstruct(list=toNumber@L2)
lastItem = List.LastItem(list=deconstruct_2.rest@L2)
mod = lastItem % deconstruct_2.first
string_from_object = FromObject(object=mod)
div = lastItem / deconstruct_2.first
floor = Math.Floor(number=div)
code_block_3 = CodeBlock(i=floor) { i+1; }
string_from_object_2 = FromObject(object=code_block_3)
length = String.Length(string=string_from_object_2)
code_block_4 = CodeBlock(i=length, str=string_from_object_2) { i == 1? "0"+str:str; }
list_create = List.Create(item0=string_from_object, item1=code_block_4)
transpose = List.Transpose(lists=list_create)
concat = String.Concat(string0=transpose)
flatten = List.Flatten(list=concat)
watch = Watch(flatten)
