# Dynamo graph OX퀴즈.dyn (Dynamo 2.13.1.3887)

code_block = CodeBlock { 1; }
code_block_2 = CodeBlock()
# ---------- code_block_2.designscript (8 lines) ----------
[
5,
"OOXXOXXOOO",
"OOXXOOXXOO",
"OXOXOXOXOXOXOX",
"OOOOOOOOOO",
"OOOOXOOOOXOOOOX"
];
# ----------------------------------------
deconstruct = List.Deconstruct(list=code_block_2)
code_block_3 = CodeBlock { "X"; }
split = String.Split(string=deconstruct.rest, separator0=code_block_3)
code_block_4 = CodeBlock { "O"; }
countOccurrences = String.CountOccurrences(string=split, searchFor=code_block_4)
range = Range(start=code_block, end=countOccurrences)
sum = Math.Sum(values=range)
sum_2 = Math.Sum(values=sum)
watch = Watch(sum_2)
