# Dynamo graph X보다 작은 수.dyn (Dynamo 2.13.1.3887)

code_block = CodeBlock { " "; }
code_block_2 = CodeBlock { "10 5"; "1 10 4 9 2 3 8 5 7 6"; }
join = List.Join(list0=code_block_2.out0, list1=code_block_2.out1)
deconstruct = List.Deconstruct(list=join)
firstItem = List.FirstItem(list=deconstruct.rest)
code_block_3 = CodeBlock { " "; }
split = String.Split(string=firstItem, separator0=code_block_3)
toNumber = String.ToNumber(string=split)
code_block_4 = CodeBlock { " "; }
split_2 = String.Split(string=deconstruct.first, separator0=code_block_4)
deconstruct_2 = List.Deconstruct(list=split_2)
firstItem_2 = List.FirstItem(list=deconstruct_2.rest)
toNumber_2 = String.ToNumber(string=firstItem_2)
lt = toNumber < toNumber_2
filterByBoolMask = List.FilterByBoolMask(list=toNumber, mask=lt)
string_from_object = FromObject(object=filterByBoolMask.in)
join_2 = String.Join(separator=code_block, string0=string_from_object)
firstItem_3 = List.FirstItem(list=join_2)
watch = Watch(firstItem_3)
code_block_5 = CodeBlock { "10 7"; "1 10 4 9 2 3 8 5 7 6"; }
join_3 = List.Join(list0=code_block_5.out0, list1=code_block_5.out1)
