# Dynamo graph 개수 세기.dyn (Dynamo 2.13.1.3887)

code_block = CodeBlock { 11; "1 4 1 2 4 2 4 2 3 4 4"; 2; }
join = List.Join(list0=code_block.out0, list1=code_block.out1, list2=code_block.out2)
code_block_2 = CodeBlock { 11; "1 4 1 2 4 2 4 2 3 4 4"; 5; }
join_2 = List.Join(list0=code_block_2.out0, list1=code_block_2.out1, list2=code_block_2.out2)
deconstruct = List.Deconstruct(list=join_2)
deconstruct_2 = List.Deconstruct(list=deconstruct.rest)
code_block_3 = CodeBlock { " "; }
split = String.Split(string=deconstruct_2.first, separator0=code_block_3)
toNumber = String.ToNumber(string=split)
allIndicesOf = List.AllIndicesOf(list=toNumber, item=deconstruct_2.rest)
flatten = List.Flatten(list=allIndicesOf)
count = List.Count(list=flatten)
watch = Watch(count)
