# Dynamo graph 과제 안 내신 분.dyn (Dynamo 2.13.1.3887)

code_block = CodeBlock { 1; 30; }
range = Range(start=code_block.out0, end=code_block.out1)
code_block_2 = CodeBlock()
# ---------- code_block_2.designscript (30 lines) ----------
[
3,
1,
4,
5,
7,
9,
6,
10,
11,
12,
13,
14,
15,
16,
17,
18,
19,
20,
21,
22,
23,
24,
25,
26,
27,
28,
29,
30
];
# ----------------------------------------
code_block_3 = CodeBlock(i=code_block_2) { i; }
contains = List.Contains(list=code_block_3, item=range@L1)
filterByBoolMask = List.FilterByBoolMask(list=range, mask=contains)
sort = List.Sort(list=filterByBoolMask.out)
watch = Watch(sort)
code_block_4 = CodeBlock()
# ---------- code_block_4.designscript (30 lines) ----------
[
9,
30,
6,
12,
10,
20,
21,
11,
7,
5,
28,
4,
18,
29,
17,
19,
27,
13,
16,
26,
14,
23,
22,
15,
3,
1,
24,
25
];
# ----------------------------------------
