# Dynamo graph 구구단.dyn (Dynamo 2.13.1.3887)

# group: 기본노드 버전
code_block = CodeBlock { " = "; }
code_block_2 = CodeBlock { " * "; }
code_block_3 = CodeBlock { 3; }
code_block_4 = CodeBlock { 1..9; }
count = List.Count(list=code_block_4)
ofRepeatedItem = List.OfRepeatedItem(item=code_block_3, amount=count)
list_create = List.Create(item0=ofRepeatedItem, item1=code_block_4)
transpose = List.Transpose(lists=list_create)
string_from_object = FromObject(object=transpose)
join = String.Join(separator=code_block_2, string0=string_from_object)
code_block_5 = CodeBlock(i=join) { i[0]; }
mul = code_block_3 * code_block_4
string_from_object_2 = FromObject(object=mul)
list_create_2 = List.Create(item0=code_block_5, item1=string_from_object_2)
transpose_2 = List.Transpose(lists=list_create_2)
join_2 = String.Join(separator=code_block, string0=transpose_2)
code_block_6 = CodeBlock(i=join_2) { i[0]; }
watch = Watch(code_block_6)

# group: 코드블럭 사용 버전
code_block_7 = CodeBlock { 2; }
code_block_8 = CodeBlock { 1..9; }
code_block_9 = CodeBlock(a=code_block_7, b=code_block_8) { a + " * " + b + " = " + a * b; }
watch_2 = Watch(code_block_9)
