# Dynamo graph 그룹 단어 체커.dyn (Dynamo 2.13.1.3887)

code_block = CodeBlock()
# ---------- code_block.designscript (7 lines) ----------
[
4,
"aba",
"abab",
"abcabc",
"a"
];
# ----------------------------------------
code_block_2 = CodeBlock()
# ---------- code_block_2.designscript (8 lines) ----------
[
5,
"ab",
"aa",
"aca",
"ba",
"bb"
];
# ----------------------------------------
code_block_3 = CodeBlock()
# ---------- code_block_3.designscript (5 lines) ----------
[
2,
"yzyzy",
"zyzyz"
];
# ----------------------------------------
code_block_4 = CodeBlock()
# ---------- code_block_4.designscript (6 lines) ----------
[
3,
"happy",
"new",
"year"
];
# ----------------------------------------
deconstruct = List.Deconstruct(list=code_block_4)
code_block_5 = CodeBlock { ""; }
split = String.Split(string=deconstruct.rest, separator0=code_block_5)
uniqueItems = List.UniqueItems(list=split@L2)
allIndicesOf = List.AllIndicesOf(list=split@L2, item=uniqueItems@L2)
firstItem = List.FirstItem(list=allIndicesOf@@L2)
count = List.Count(list=allIndicesOf@@L2)
sequence = Sequence(start=firstItem, amount=count)
string_from_object = FromObject(object=sequence)
concat = String.Concat(string0=string_from_object)
flatten = List.Flatten(list=concat@L2)
concat_2 = String.Concat(string0=flatten)
flatten_2 = List.Flatten(list=concat_2)
string_from_object_2 = FromObject(object=allIndicesOf)
concat_3 = String.Concat(string0=string_from_object_2)
flatten_3 = List.Flatten(list=concat_3@L2)
concat_4 = String.Concat(string0=flatten_3)
flatten_4 = List.Flatten(list=concat_4)
eq = flatten_2 == flatten_4
countTrue = List.CountTrue(list=eq)
watch = Watch(countTrue)
code_block_6 = CodeBlock()
# ---------- code_block_6.designscript (4 lines) ----------
[
1,
"z"
];
# ----------------------------------------
