# Dynamo graph 나는야 포켓몬 마스터 이다솜.dyn (Dynamo 2.16.1.2727)

list_create = List.Create()  # unwired: item0, item1
code_block = CodeBlock()
# ---------- code_block.designscript (32 lines) ----------
"26 5
Bulbasaur
Ivysaur
Venusaur
Charmander
Charmeleon
Charizard
Squirtle
Wartortle
Blastoise
Caterpie
Metapod
Butterfree
Weedle
Kakuna
Beedrill
Pidgey
Pidgeotto
Pidgeot
Rattata
Raticate
Spearow
Fearow
Ekans
Arbok
Pikachu
Raichu
25
Raichu
3
Pidgey
Kakuna";
# ----------------------------------------
code_block_2 = CodeBlock { "\n"; }
split = String.Split(string=code_block, separator0=code_block_2)
code_block_3 = CodeBlock { " "; }
split_2 = String.Split(string=split, separator0=code_block_3)
deconstruct = List.Deconstruct(list=split_2)
flatten = List.Flatten(list=deconstruct.rest)
add = _ + _  # unwired: x, y
code_block_4 = CodeBlock { 0; }
toNumber = String.ToNumber(string=deconstruct.first)
scan = ScanList(reduceFunction=add, seed=code_block_4, list0=toNumber)  # "List.Scan"
code_block_5 = CodeBlock { 0..1; 1; }
sublists = List.Sublists(list=scan, ranges=code_block_5.out0, offset=code_block_5.out1)
code_block_6 = CodeBlock { -1; }
dropItems = List.DropItems(list=sublists, amount=code_block_6)
firstItem = List.FirstItem(list=dropItems)
lastItem = List.LastItem(list=dropItems)
slice = List.Slice(list=flatten, start=firstItem, end=lastItem)
lastItem_2 = List.LastItem(list=slice)
toUpper = String.ToUpper(string=lastItem_2)
eq = lastItem_2 == toUpper
boolean = BoolSelector(true)
allIndicesOf = List.AllIndicesOf(list=eq, item=boolean)
firstItem_2 = List.FirstItem(list=slice)
getItemAtIndex = List.GetItemAtIndex(list=lastItem_2, index=allIndicesOf)
toNumber_2 = String.ToNumber(string=getItemAtIndex)
code_block_7 = CodeBlock { 1; }
sub = toNumber_2 - code_block_7
getItemAtIndex_2 = List.GetItemAtIndex(list=firstItem_2, index=sub)
list_create_2 = List.Create(item0=allIndicesOf, item1=getItemAtIndex_2)
transpose = List.Transpose(lists=list_create_2)
boolean_2 = BoolSelector(false)
allIndicesOf_2 = List.AllIndicesOf(list=eq, item=boolean_2)
getItemAtIndex_3 = List.GetItemAtIndex(list=lastItem_2, index=allIndicesOf_2)
allIndicesOf_3 = List.AllIndicesOf(list=firstItem_2, item=getItemAtIndex_3)
code_block_8 = CodeBlock { 1; }
add_2 = allIndicesOf_3 + code_block_8
flatten_2 = List.Flatten(list=add_2)
list_create_3 = List.Create(item0=allIndicesOf_2, item1=flatten_2)
transpose_2 = List.Transpose(lists=list_create_3)
join = List.Join(list0=transpose, list1=transpose_2)
firstItem_3 = List.FirstItem()  # unwired: list
sortByFunction = List.SortByFunction(list=join, sortFunction=firstItem_3)
transpose_3 = List.Transpose(lists=sortByFunction)
lastItem_3 = List.LastItem(list=transpose_3)
watch = Watch(lastItem_3)
