# Dynamo graph 나머지.dyn (Dynamo 2.13.1.3887)

code_block = CodeBlock()
# ---------- code_block.designscript (12 lines) ----------
[
1,
2,
3,
4,
5,
6,
7,
8,
9,
10
];
# ----------------------------------------
code_block_2 = CodeBlock()
# ---------- code_block_2.designscript (12 lines) ----------
[
42,
84,
252,
420,
840,
126,
42,
84,
420,
126
];
# ----------------------------------------
code_block_3 = CodeBlock()
# ---------- code_block_3.designscript (12 lines) ----------
[
39,
40,
41,
42,
43,
44,
82,
83,
84,
85
];
# ----------------------------------------
code_block_4 = CodeBlock { 42; }
mod = code_block_3 % code_block_4
groupByKey = List.GroupByKey(list=mod, keys=mod)
count = List.Count(list=groupByKey.uniqueKeys)
watch = Watch(count)
