# Dynamo graph 나이순 정렬.dyn (Dynamo 2.16.1.2727)

code_block = CodeBlock { " "; }
code_block_2 = CodeBlock()
# ---------- code_block_2.designscript (6 lines) ----------
[
"3",
"21 Junkyu",
"21 Dohyun",
"20 Sunyoung"
];
# ----------------------------------------
deconstruct = List.Deconstruct(list=code_block_2)
code_block_3 = CodeBlock { " "; }
split = String.Split(string=deconstruct.rest, separator0=code_block_3)
count = List.Count(list=split)
code_block_4 = CodeBlock(i=count) { i-1; }
range = Range(end=code_block_4)
transpose = List.Transpose(lists=split)
firstItem = List.FirstItem(list=transpose)
toNumber = String.ToNumber(string=firstItem)
lastItem = List.LastItem(list=transpose)
list_create = List.Create(item0=range, item1=toNumber, item2=lastItem)
transpose_2 = List.Transpose(lists=list_create)
code_block_5 = CodeBlock { 1; }
getItemAtIndex = List.GetItemAtIndex(list=transpose_2@L2, index=code_block_5)
groupByKey = List.GroupByKey(list=transpose_2, keys=getItemAtIndex)
firstItem_2 = List.FirstItem(list=groupByKey.groups@L2)
count_2 = List.Count(list=groupByKey.groups@L3)
chop = List.Chop(list=firstItem_2, lengths=count_2)
sortByKey = List.SortByKey(list=groupByKey.groups@L3, keys=chop@L2)
code_block_6 = CodeBlock(i=sortByKey.sortedList) { i; }
code_block_7 = CodeBlock { 1; }
getItemAtIndex_2 = List.GetItemAtIndex(list=code_block_6@L2, index=code_block_7)
uniqueItems = List.UniqueItems(list=getItemAtIndex_2)
sortByKey_2 = List.SortByKey(list=code_block_6, keys=uniqueItems)
flatten = List.Flatten(list=sortByKey_2.sortedList@L2)
deconstruct_2 = List.Deconstruct(list=flatten@L2)
code_block_8 = CodeBlock(i=deconstruct_2.rest) { i; }
string_from_object = FromObject(object=code_block_8)
join = String.Join(separator=code_block, string0=string_from_object)
flatten_2 = List.Flatten(list=join)
watch = Watch(flatten_2)
