# Dynamo graph 너의 평점은.dyn (Dynamo 2.16.1.2727)

code_block = CodeBlock()
# ---------- code_block.designscript (20 lines) ----------
"BruteForce 3.0 F
Greedy 1.0 F
DivideandConquer 2.0 F
DynamicProgramming 3.0 F
DepthFirstSearch 4.0 F
BreadthFirstSearch 3.0 F
ShortestPath 4.0 F
DisjointSet 2.0 F
MinimumSpanningTree 2.0 F
TopologicalSorting 1.0 F
LeastCommonAncestor 2.0 F
SegmentTree 4.0 F
EulerTourTechnique 3.0 F
StronglyConnectedComponent 2.0 F
BipartiteMatching 2.0 F
MaximumFlowProblem 3.0 F
SuffixArray 1.0 F
HeavyLightDecomposition 4.0 F
CentroidDecomposition 3.0 F
SplayTree 1.0 F";
# ----------------------------------------
code_block_2 = CodeBlock()
# ---------- code_block_2.designscript (9 lines) ----------
"A+	4.5
A0	4.0
B+	3.5
B0	3.0
C+	2.5
C0	2.0
D+	1.5
D0	1.0
F	0.0";
# ----------------------------------------
code_block_3 = CodeBlock { "\n"; }
split = String.Split(string=code_block_2, separator0=code_block_3)
# note: 'tab'
code_block_4 = CodeBlock { "	"; }
split_2 = String.Split(string=split, separator0=code_block_4)
firstItem = List.FirstItem(list=split_2@L2)
lastItem = List.LastItem(list=split_2@L2)
toNumber = String.ToNumber(string=lastItem)
byKeysValues = DesignScript.Builtin.Dictionary.ByKeysValues(keys=firstItem, values=toNumber)
code_block_5 = CodeBlock()
# ---------- code_block_5.designscript (20 lines) ----------
"ObjectOrientedProgramming1 3.0 A+
IntroductiontoComputerEngineering 3.0 A+
ObjectOrientedProgramming2 3.0 A0
CreativeComputerEngineeringDesign 3.0 A+
AssemblyLanguage 3.0 A+
InternetProgramming 3.0 B0
ApplicationProgramminginJava 3.0 A0
SystemProgramming 3.0 B0
OperatingSystem 3.0 B0
WirelessCommunicationsandNetworking 3.0 C+
LogicCircuits 3.0 B0
DataStructure 4.0 A+
MicroprocessorApplication 3.0 B+
EmbeddedSoftware 3.0 C0
ComputerSecurity 3.0 D+
Database 3.0 C+
Algorithm 3.0 B0
CapstoneDesigninCSE 3.0 B+
CompilerDesign 3.0 D0
ProblemSolving 4.0 P";
# ----------------------------------------
code_block_6 = CodeBlock { "\n"; }
split_3 = String.Split(string=code_block_5, separator0=code_block_6)
code_block_7 = CodeBlock { " "; }
split_4 = String.Split(string=split_3, separator0=code_block_7)
code_block_8 = CodeBlock { 1; }
getItemAtIndex = List.GetItemAtIndex(list=split_4@L2, index=code_block_8)
toNumber_2 = String.ToNumber(string=getItemAtIndex)
replaceItemAtIndex = List.ReplaceItemAtIndex(list=split_4@L2, index=code_block_8, item=toNumber_2@L1)
lastItem_2 = List.LastItem(list=replaceItemAtIndex@L2)
code_block_9 = CodeBlock { "P"; }
ne = lastItem_2 != code_block_9
filterByBoolMask = List.FilterByBoolMask(list=replaceItemAtIndex, mask=ne)
lastItem_3 = List.LastItem(list=filterByBoolMask.in@L2)
valueAtKey = DesignScript.Builtin.Dictionary.ValueAtKey(dictionary=byKeysValues, key=lastItem_3)
code_block_10 = CodeBlock { 1; }
getItemAtIndex_2 = List.GetItemAtIndex(list=filterByBoolMask.in@L2, index=code_block_10)
mul = valueAtKey * getItemAtIndex_2
sum = Math.Sum(values=mul)
sum_2 = Math.Sum(values=getItemAtIndex_2)
div = sum / sum_2
code_block_11 = CodeBlock { 6; }
round = Math.Round(number=div, digits=code_block_11)
watch = Watch(round)
