# Dynamo graph 네 번째 점.dyn (Dynamo 2.16.1.2727)

code_block = CodeBlock()
# ---------- code_block.designscript (3 lines) ----------
"5 5
5 7
7 5";
# ----------------------------------------
code_block_2 = CodeBlock { " "; }
code_block_3 = CodeBlock()
# ---------- code_block_3.designscript (3 lines) ----------
"30 20
10 10
10 20";
# ----------------------------------------
code_block_4 = CodeBlock { "\n"; }
split = String.Split(string=code_block_3, separator0=code_block_4)
code_block_5 = CodeBlock { " "; }
split_2 = String.Split(string=split, separator0=code_block_5)
toNumber = String.ToNumber(string=split_2)
code_block_6 = CodeBlock { 0; }
getItemAtIndex = List.GetItemAtIndex(list=toNumber, index=code_block_6)
code_block_7 = CodeBlock { 1; }
getItemAtIndex_2 = List.GetItemAtIndex(list=toNumber, index=code_block_7)
eq = getItemAtIndex == getItemAtIndex_2
anyTrue = List.AnyTrue(list=eq)
code_block_8 = CodeBlock { 2; }
getItemAtIndex_3 = List.GetItemAtIndex(list=toNumber, index=code_block_8)
eq_2 = getItemAtIndex == getItemAtIndex_3
anyTrue_2 = List.AnyTrue(list=eq_2)
join = List.Join(list0=anyTrue, list1=anyTrue_2)
allTrue = List.AllTrue(list=join)
sub = getItemAtIndex - getItemAtIndex_2
sub_2 = getItemAtIndex - getItemAtIndex_3
add = sub + sub_2

# group: 첫점이 가운데 점일때
sub_3 = getItemAtIndex - add

sub_4 = sub - sub_2

# group: 끝점일때
sub_5 = getItemAtIndex - sub_4

if_ = RefactoredIf(test=allTrue, true=sub_3, false=sub_5)
string_from_object = FromObject(object=if_)
join_2 = String.Join(separator=code_block_2, string0=string_from_object)
watch = Watch(join_2)
