# Dynamo graph 다이얼.dyn (Dynamo 2.13.1.3887)

code_block = CodeBlock { {}; }
code_block_2 = CodeBlock { 9; }
range = Range(end=code_block_2)
count = List.Count(list=range)
ofRepeatedItem = List.OfRepeatedItem(item=code_block, amount=count)
code_block_3 = CodeBlock { "number"; }
ofRepeatedItem_2 = List.OfRepeatedItem(item=code_block_3, amount=count)
setValueAtKeys = DesignScript.Builtin.Dictionary.SetValueAtKeys(dictionary=ofRepeatedItem, keys=ofRepeatedItem_2, values=range, lacing=Shortest)
code_block_4 = CodeBlock { "assignStr"; }
code_block_5 = CodeBlock { [["   "],["   "]]; }
code_block_6 = CodeBlock { 65; 90; }
range_2 = Range(start=code_block_6.out0, end=code_block_6.out1)
python_script = Python(IN[0]=range_2)  # CPython3
# ---------- python_script.python (14 lines) ----------
# Load the Python Standard and DesignScript Libraries
import sys
import clr
clr.AddReference('ProtoGeometry')
from Autodesk.DesignScript.Geometry import *

# The inputs to this node will be stored as a list in the IN variables.
dataEnteringNode = IN
inputs = IN[0]

# Place your code below this line

# Assign your output to the OUT variable.
OUT = map(chr, inputs)
# ----------------------------------------
code_block_7 = CodeBlock { 0..2; }
code_block_8 = CodeBlock { 3; }
sublists = List.Sublists(list=python_script, ranges=code_block_7, offset=code_block_8)
code_block_9 = CodeBlock { 0..4; }
getItemAtIndex = List.GetItemAtIndex(list=sublists, index=code_block_9)
code_block_10 = CodeBlock { 5..8; }
getItemAtIndex_2 = List.GetItemAtIndex(list=sublists, index=code_block_10)
flatten = List.Flatten(list=getItemAtIndex_2)
code_block_11 = CodeBlock { [0,4,7]; [4,7,11]; }
slice = List.Slice(list=flatten, start=code_block_11.out0, end=code_block_11.out1)
join = List.Join(list0=getItemAtIndex, list1=slice)
join_2 = List.Join(list0=code_block_5, list1=join)
concat = String.Concat(string0=join_2)
flatten_2 = List.Flatten(list=concat)
count_2 = List.Count(list=flatten_2)
ofRepeatedItem_3 = List.OfRepeatedItem(item=code_block_4, amount=count_2)
setValueAtKeys_2 = DesignScript.Builtin.Dictionary.SetValueAtKeys(dictionary=setValueAtKeys@L1, keys=ofRepeatedItem_3@L1, values=flatten_2@L1, lacing=Shortest)
code_block_12 = CodeBlock { "takeTime"; }
code_block_13 = CodeBlock(i=count_2) { 2; i+1; }
range_3 = Range(start=code_block_13.out0, end=code_block_13.out1)
lastItem = List.LastItem(list=range_3)
addItemToFront = List.AddItemToFront(item=lastItem, list=range_3)
count_3 = List.Count(list=addItemToFront)
code_block_14 = CodeBlock(i=count_3) { i-1; }
removeItemAtIndex = List.RemoveItemAtIndex(list=addItemToFront, indices=code_block_14)
ofRepeatedItem_4 = List.OfRepeatedItem(item=code_block_12, amount=removeItemAtIndex)
setValueAtKeys_3 = DesignScript.Builtin.Dictionary.SetValueAtKeys(dictionary=setValueAtKeys_2@L1, keys=ofRepeatedItem_4@L1, values=removeItemAtIndex@L1, lacing=Shortest)
code_block_15 = CodeBlock { "takeTime"; }
valueAtKey = DesignScript.Builtin.Dictionary.ValueAtKey(dictionary=setValueAtKeys_3, key=code_block_15)
code_block_16 = CodeBlock { "assignStr"; }
valueAtKey_2 = DesignScript.Builtin.Dictionary.ValueAtKey(dictionary=setValueAtKeys_3, key=code_block_16)
code_block_17 = CodeBlock { "WA"; "UNUCIC"; }
code_block_18 = CodeBlock(i=code_block_17.out0) { i; }
code_block_19 = CodeBlock(i=code_block_18) { i; }
code_block_20 = CodeBlock { ""; }
split = String.Split(string=code_block_19, separator0=code_block_20)
contains = String.Contains(string=valueAtKey_2, searchFor=split, lacing=CrossProduct)
boolean = BoolSelector(true)
allIndicesOf = List.AllIndicesOf(list=contains@L2, item=boolean)
count_4 = List.Count(list=allIndicesOf@L2)
mul = valueAtKey * count_4
sum = Math.Sum(values=mul)
watch = Watch(sum)
