# Dynamo graph 단어 공부.dyn (Dynamo 2.13.1.3887)

code_block = CodeBlock { "Mississipi"; "zZa"; "z"; "baaa"; }
code_block_2 = CodeBlock { ""; }
split = String.Split(string=code_block.out3, separator0=code_block_2)
toUpper = String.ToUpper(string=split)
groupByKey = List.GroupByKey(list=toUpper, keys=toUpper)
count = List.Count(list=groupByKey.groups@L2)
maximumItem = List.MaximumItem(list=count)
code_block_3 = CodeBlock(i=maximumItem) { i :int; }
allIndicesOf = List.AllIndicesOf(list=count, item=code_block_3)
count_2 = List.Count(list=allIndicesOf)
code_block_4 = CodeBlock { 1; }
gt = count_2 > code_block_4
code_block_5 = CodeBlock { "?"; }
code_block_6 = CodeBlock(i=maximumItem) { i :int; }
indexOf = List.IndexOf(list=count, element=code_block_6)
getItemAtIndex = List.GetItemAtIndex(list=toUpper, index=indexOf)
if_ = RefactoredIf(test=gt, true=code_block_5, false=getItemAtIndex)
watch = Watch(if_)
