# Dynamo graph 단어 정렬.dyn (Dynamo 2.16.1.2727)

code_block = CodeBlock()
# ---------- code_block.designscript (16 lines) ----------
[
"13",
"but",
"i",
"wont",
"hesitate",
"no",
"more",
"no",
"more",
"it",
"cannot",
"wait",
"im",
"yours"
];
# ----------------------------------------
deconstruct = List.Deconstruct(list=code_block)
uniqueItems = List.UniqueItems(list=deconstruct.rest)
length = String.Length(string=uniqueItems)
sortByKey = List.SortByKey(list=uniqueItems, keys=length)
groupByKey = List.GroupByKey(list=sortByKey.sortedList, keys=sortByKey.sortedKeys)
sort = List.Sort(list=groupByKey.groups)
flatten = List.Flatten(list=sort)
watch = Watch(flatten)
