# Dynamo graph 단어의 개수.dyn (Dynamo 2.13.1.3887)

code_block = CodeBlock { "The Curious Case of Benjamin Button"; " The first character is a blank"; "The last character is a blank "; }
code_block_2 = CodeBlock { " "; }
split = String.Split(string=code_block.out0, separator0=code_block_2)
toLower = String.ToLower(string=split)
uniqueItems = List.UniqueItems(list=toLower)
count = List.Count(list=uniqueItems)
watch = Watch(count)
