# Dynamo graph 달팽이는 올라가고 싶다.dyn (Dynamo 2.13.1.3887)

code_block = CodeBlock { ["A", "B", "V"]; }
code_block_2 = CodeBlock { "2 1 5"; "5 1 6"; "100 99 1000000000"; }
code_block_3 = CodeBlock { " "; }
split = String.Split(string=code_block_2.out2, separator0=code_block_3)
toNumber = String.ToNumber(string=split)
# note: (A - B) * x >= (V - B)
# x >= (V - B) / (A - B)
byKeysValues = DesignScript.Builtin.Dictionary.ByKeysValues(keys=code_block, values=toNumber)
code_block_4 = CodeBlock(i=byKeysValues) { (i["V"]-i["B"]) / (i["A"]-i["B"]); }
ceiling = Math.Ceiling(number=code_block_4)
watch = Watch(ceiling)
