# Dynamo graph 대지.dyn (Dynamo 2.16.1.2727)

code_block = CodeBlock()
# ---------- code_block.designscript (4 lines) ----------
"3
20 24
40 21
10 12";
# ----------------------------------------
code_block_2 = CodeBlock()
# ---------- code_block_2.designscript (2 lines) ----------
"1
15 13";
# ----------------------------------------
code_block_3 = CodeBlock()
# ---------- code_block_3.designscript (5 lines) ----------
"4
2 1
3 2
5 2
3 4";
# ----------------------------------------
code_block_4 = CodeBlock { "\n"; }
split = String.Split(string=code_block_3, separator0=code_block_4)
deconstruct = List.Deconstruct(list=split)
code_block_5 = CodeBlock { " "; }
split_2 = String.Split(string=deconstruct.rest, separator0=code_block_5)
toNumber = String.ToNumber(string=split_2)
firstItem = List.FirstItem(list=toNumber@L2)
minimumItem = List.MinimumItem(list=firstItem)
maximumItem = List.MaximumItem(list=firstItem)
sub = minimumItem - maximumItem
abs = Math.Abs(number=sub)
lastItem = List.LastItem(list=toNumber@L2)
minimumItem_2 = List.MinimumItem(list=lastItem)
maximumItem_2 = List.MaximumItem(list=lastItem)
sub_2 = minimumItem_2 - maximumItem_2
abs_2 = Math.Abs(number=sub_2)
mul = abs * abs_2
watch = Watch(mul)
