# Dynamo graph 대칭 차집합.dyn (Dynamo 2.16.1.2727)

code_block = CodeBlock()
# ---------- code_block.designscript (3 lines) ----------
"3 5
1 2 4
2 3 4 5 6";
# ----------------------------------------
code_block_2 = CodeBlock { "\n"; }
split = String.Split(string=code_block, separator0=code_block_2)
code_block_3 = CodeBlock { " "; }
split_2 = String.Split(string=split, separator0=code_block_3)
toNumber = String.ToNumber(string=split_2)
deconstruct = List.Deconstruct(list=toNumber)
firstItem = List.FirstItem(list=deconstruct.rest)
lastItem = List.LastItem(list=deconstruct.rest)
setDifference = List.SetDifference(list1=firstItem, list2=lastItem)
setDifference_2 = List.SetDifference(list1=lastItem, list2=firstItem)
setUnion = List.SetUnion(list1=setDifference, list2=setDifference_2)
count = List.Count(list=setUnion)
watch = Watch(count)
