# Dynamo graph 대표값2(정렬).dyn (Dynamo 2.13.1.3887)

code_block = CodeBlock { 10; 40; 30; 60; 30; }
join = List.Join(list0=code_block.out0, list1=code_block.out1, list2=code_block.out2, list3=code_block.out3, list4=code_block.out4)
average = Math.Average(numbers=join)
sort = List.Sort(list=join)
count = List.Count(list=join)
code_block_2 = CodeBlock { 2; }
div = count / code_block_2
floor = Math.Floor(number=div)
getItemAtIndex = List.GetItemAtIndex(list=sort, index=floor)
join_2 = List.Join(list0=average, list1=getItemAtIndex)
watch = Watch(join_2)
