# Dynamo graph 더하기 사이클.dyn (Dynamo 2.13.1.3887)

code_block = CodeBlock { 55; }
code_block_2 = CodeBlock { 1; }
code_block_3 = CodeBlock { 0; }
code_block_4 = CodeBlock { 71; }
code_block_5 = CodeBlock { 26; }
python_script = Python(IN[0]=code_block_5)  # CPython3
# ---------- python_script.python (56 lines) ----------
# Load the Python Standard and DesignScript Libraries
import sys
import clr
clr.AddReference('ProtoGeometry')
from Autodesk.DesignScript.Geometry import *

# The inputs to this node will be stored as a list in the IN variables.
dataEnteringNode = IN
input = IN[0]
# Place your code below this line

def find_digitNum(num):
    return len(str(num))

def is_twodigit(num):
    if find_digitNum(num) == 2:
        return True
    else: return False

def split_num(num):
    return list(map(int, str(num)))

def combine_nums(nums):
    num1,num2 = nums
    return int(str(num1)+str(num2))

def convert_num(num):
    cases = {
            True: 
                split_num(num),
            False: 
                [0, num]
            }

    nums = cases[is_twodigit(num)]
    new_firstNum = nums[-1]
    new_lastNum = split_num(sum(nums))[-1]
    
    return combine_nums([new_firstNum, new_lastNum])


def calc_convertCycle(num):
    cTimes = 0
    target = num
    while True:
        if convert_num(target) == num:
            target = convert_num(target)
            cTimes += 1
            return cTimes
            break
        else:
            target = convert_num(target)
            cTimes += 1

# Assign your output to the OUT variable.
OUT = calc_convertCycle(input)
# ----------------------------------------
watch = Watch(python_script)
