# Dynamo graph 덩치.dyn (Dynamo 2.16.1.2727)

code_block = CodeBlock { " "; }
code_block_2 = CodeBlock { 1; }
code_block_3 = CodeBlock()
# ---------- code_block_3.designscript (6 lines) ----------
5;
"55 185,
58 183,
88 186,
60 175,
46 155";
# ----------------------------------------
code_block_4 = CodeBlock { ","; }
split = String.Split(string=code_block_3.out1, separator0=code_block_4)
code_block_5 = CodeBlock { " "; }
split_2 = String.Split(string=split, separator0=code_block_5)
toNumber = String.ToNumber(string=split_2)
lt = toNumber < toNumber  # lacing=CrossProduct
allTrue = List.AllTrue(list=lt@L2)
count = List.Count(list=lt@L3)
chop = List.Chop(list=allTrue, lengths=count)
countTrue = List.CountTrue(list=chop@L2)
add = code_block_2 + countTrue
string_from_object = FromObject(object=add)
join = String.Join(separator=code_block, string0=string_from_object)
watch = Watch(join)
