# Dynamo graph 두 수 비교하기.dyn (Dynamo 2.13.1.3887)

code_block = CodeBlock { 1; 2; }
code_block_2 = CodeBlock { 10; 2; }
code_block_3 = CodeBlock { 5; 5; }
code_block_4 = CodeBlock(a=code_block_3.out0, b=code_block_3.out1) { a; b; }
sub = code_block_4.a - code_block_4.b
code_block_5 = CodeBlock { 0; }
gt = sub > code_block_5
code_block_6 = CodeBlock { ">"; }
eq = code_block_4.a == code_block_4.b
code_block_7 = CodeBlock { "=="; "<"; }
if_ = RefactoredIf(test=eq, true=code_block_7.out0, false=code_block_7.out1)
if_2 = RefactoredIf(test=gt, true=code_block_6, false=if_)
watch = Watch(if_2)
