# Dynamo graph 듣보잡.dyn (Dynamo 2.16.1.2727)

code_block = CodeBlock { 0; }
list_create = List.Create()  # unwired: item0, item1
code_block_2 = CodeBlock()
# ---------- code_block_2.designscript (8 lines) ----------
"3 4
ohhenrie
charlie
baesangwook
obama
baesangwook
ohhenrie
clinton";
# ----------------------------------------
code_block_3 = CodeBlock { "\n"; }
split = String.Split(string=code_block_2, separator0=code_block_3)
deconstruct = List.Deconstruct(list=split)
code_block_4 = CodeBlock(i=deconstruct.rest) { i; }
add = _ + _  # unwired: x, y
code_block_5 = CodeBlock { 0; }
code_block_6 = CodeBlock { " "; }
split_2 = String.Split(string=deconstruct.first, separator0=code_block_6)
toNumber = String.ToNumber(string=split_2)
scan = ScanList(reduceFunction=add, seed=code_block_5, list0=toNumber)  # "List.Scan"
code_block_7 = CodeBlock { 0..1; 1; }
sublists = List.Sublists(list=scan, ranges=code_block_7.out0, offset=code_block_7.out1)
code_block_8 = CodeBlock { -1; }
dropItems = List.DropItems(list=sublists, amount=code_block_8)
firstItem = List.FirstItem(list=dropItems)
lastItem = List.LastItem(list=dropItems)
slice = List.Slice(list=code_block_4, start=firstItem, end=lastItem)
firstItem_2 = List.FirstItem(list=slice)
lastItem_2 = List.LastItem(list=slice)
setIntersection = List.SetIntersection(list1=firstItem_2, list2=lastItem_2)
count = List.Count(list=setIntersection)
join = List.Join(list0=count, list1=setIntersection)
watch = Watch(join)
