# Dynamo graph 문자열 집합.dyn (Dynamo 2.16.1.2727)

code_block = CodeBlock()
# ---------- code_block.designscript (17 lines) ----------
"5 11
baekjoononlinejudge
startlink
codeplus
sundaycoding
codingsh
baekjoon
codeplus
codeminus
startlink
starlink
sundaycoding
codingsh
codinghs
sondaycoding
startrink
icerink";
# ----------------------------------------
code_block_2 = CodeBlock { "\n"; }
split = String.Split(string=code_block, separator0=code_block_2)
deconstruct = List.Deconstruct(list=split)
code_block_3 = CodeBlock { 0; }
code_block_4 = CodeBlock { " "; }
split_2 = String.Split(string=deconstruct.first, separator0=code_block_4)
toNumber = String.ToNumber(string=split_2)
firstItem = List.FirstItem(list=toNumber)
join = List.Join(list0=code_block_3, list1=firstItem)
add = _ + _  # unwired: x, y
code_block_5 = CodeBlock { 0; }
scan = ScanList(reduceFunction=add, seed=code_block_5, list0=toNumber)  # "List.Scan"
deconstruct_2 = List.Deconstruct(list=scan)
slice = List.Slice(list=deconstruct.rest, start=join, end=deconstruct_2.rest)
firstItem_2 = List.FirstItem(list=slice)
lastItem = List.LastItem(list=slice)
eq = firstItem_2 == lastItem@L1
anyTrue = List.AnyTrue(list=eq@L2)
countTrue = List.CountTrue(list=anyTrue)
watch = Watch(countTrue)
