# Dynamo graph 벌집.dyn (Dynamo 2.13.1.3887)

code_block = CodeBlock { 13; 67; 58; 12; 37; 177; }
code_block_2 = CodeBlock(i=code_block.out2) { i; }
code_block_3 = CodeBlock(i=code_block_2) { i; }
add = _ + _  # unwired: x, y
code_block_4 = CodeBlock { 2; }
code_block_5 = CodeBlock { 6; }
code_block_6 = CodeBlock { 1; }
sequence = Sequence(start=code_block_6, amount=code_block_2)
# note: 주어진 수까지 배열을 6각형 배치하면 몇바퀴까지 감을수 있는가?
# 최단거리 방 이동 개수는 바퀴수 + 1
deconstruct = List.Deconstruct(list=sequence)
count = List.Count(list=deconstruct.rest)
range = Range(start=code_block_5, end=count, step=code_block_5)
scan = ScanList(reduceFunction=add, seed=code_block_4, list0=range)  # "List.Scan"
ge = code_block_3 >= scan
countTrue = List.CountTrue(list=ge)
# note: 1번방 자신 포함
code_block_7 = CodeBlock { 1; }
add_2 = countTrue + code_block_7
watch = Watch(add_2)
