# Dynamo graph 베라의 패션.dyn (Dynamo 2.16.1.2727)

code_block = CodeBlock { 1; }
code_block_2 = CodeBlock { 2; }
list_create = List.Create()  # unwired: item0, item1
code_block_3 = CodeBlock { 1; }
code_block_4 = CodeBlock { 5; }
sequence = Sequence(start=code_block_3, amount=code_block_4)
cartesianProduct = List.CartesianProduct(combineFunction=list_create, list0=sequence, list1=sequence)
flatten = List.Flatten(list=cartesianProduct@L2)
firstItem = List.FirstItem(list=flatten@L2)
lastItem = List.LastItem(list=flatten@L2)
eq = firstItem == lastItem
filterByBoolMask = List.FilterByBoolMask(list=flatten, mask=eq)
watch = Watch(filterByBoolMask.out)
count = List.Count(list=watch)
watch_2 = Watch(count)
