# Dynamo graph 별 찍기-2.dyn (Dynamo 2.13.1.3887)

code_block = CodeBlock { ""; }
code_block_2 = CodeBlock { "*"; }
code_block_3 = CodeBlock { 1; }
code_block_4 = CodeBlock { 5; }
range = Range(start=code_block_3, end=code_block_4)
ofRepeatedItem = List.OfRepeatedItem(item=code_block_2, amount=range)
join = String.Join(separator=code_block, string0=ofRepeatedItem)
flatten = List.Flatten(list=join)
length = String.Length(string=flatten)
maximumItem = List.MaximumItem(list=length)
padLeft = String.PadLeft(string=flatten, newLength=maximumItem)
watch = Watch(padLeft)
