# Dynamo graph 분수 합.dyn (Dynamo 2.16.1.2727)

code_block = CodeBlock()
# ---------- code_block.designscript (2 lines) ----------
"2 7
3 5";
# ----------------------------------------
code_block_2 = CodeBlock { "\n"; }
split = String.Split(string=code_block, separator0=code_block_2)
code_block_3 = CodeBlock { " "; }
split_2 = String.Split(string=split, separator0=code_block_3)
toNumber = String.ToNumber(string=split_2)
minimumItem = List.MinimumItem(list=toNumber@L2)

# group: i
code_block_4 = CodeBlock { 1; -1; }
range = Range(start=minimumItem, end=code_block_4.out0, step=code_block_4.out1)

# group: a
firstItem = List.FirstItem(list=toNumber@L2)

# group: b
lastItem = List.LastItem(list=toNumber@L2)
