# Dynamo graph 분수찾기.dyn (Dynamo 2.13.1.3887)

code_block = CodeBlock { "/"; }
code_block_2 = CodeBlock { 1; }
code_block_3 = CodeBlock { 1; }
code_block_4 = CodeBlock { 1; 2; 3; 4; 5; 6; 7; 8; 9; 14; }
code_block_5 = CodeBlock(i=code_block_4.out9) { i; }
range = Range(start=code_block_3, end=code_block_5)
count = List.Count(list=range)
add = _ + _  # unwired: x, y
code_block_6 = CodeBlock { 0; }
scan = ScanList(reduceFunction=add, seed=code_block_6, list0=range)  # "List.Scan"
gt = count > scan
countTrue = List.CountTrue(list=gt)
code_block_7 = CodeBlock(i=countTrue) { i+1; }
range_2 = Range(start=code_block_2, end=code_block_7)
range_3 = Range(start=code_block_2, end=range_2)
count_2 = List.Count(list=range_3)
code_block_8 = CodeBlock(i=count_2) { i-1; }
range_4 = Range(end=code_block_8)
code_block_9 = CodeBlock(i=range_4) { i%2==0?true:false; }
filterByBoolMask = List.FilterByBoolMask(list=range_4, mask=code_block_9)
getItemAtIndex = List.GetItemAtIndex(list=range_3, index=filterByBoolMask.out)
reverse = List.Reverse(list=range_3@L2)
getItemAtIndex_2 = List.GetItemAtIndex(list=reverse, index=filterByBoolMask.in)
addItemToEnd = List.AddItemToEnd(item=getItemAtIndex@L2, list=getItemAtIndex_2@L2)
flatten = List.Flatten(list=addItemToEnd)
getItemAtIndex_3 = List.GetItemAtIndex(list=reverse, index=filterByBoolMask.out)
getItemAtIndex_4 = List.GetItemAtIndex(list=range_3, index=filterByBoolMask.in)
addItemToEnd_2 = List.AddItemToEnd(item=getItemAtIndex_3@L2, list=getItemAtIndex_4@L2)
flatten_2 = List.Flatten(list=addItemToEnd_2)
list_create = List.Create(item0=flatten, item1=flatten_2)
transpose = List.Transpose(lists=list_create)
code_block_10 = CodeBlock(i=code_block_5) { i; }
code_block_11 = CodeBlock(i=code_block_10) { i-1; }
getItemAtIndex_5 = List.GetItemAtIndex(list=transpose, index=code_block_11)
string_from_object = FromObject(object=getItemAtIndex_5)
join = String.Join(separator=code_block, string0=string_from_object)
watch = Watch(join)
