# Dynamo graph 분해합.dyn (Dynamo 2.16.1.2727)

code_block = CodeBlock { 216; }
code_block_2 = CodeBlock(j=code_block) { j; 1..j-1; }
sub = code_block_2.j - code_block_2.out1
string_from_object = FromObject(object=code_block_2.out1)
code_block_3 = CodeBlock(i=string_from_object) { i; }
code_block_4 = CodeBlock { ""; }
split = String.Split(string=code_block_3, separator0=code_block_4)
toNumber = String.ToNumber(string=split)
sum = Math.Sum(values=toNumber@L2)
eq = sub == sum
code_block_5 = CodeBlock { true; }
allIndicesOf = List.AllIndicesOf(list=eq, item=code_block_5)
getItemAtIndex = List.GetItemAtIndex(list=code_block_2.out1, index=allIndicesOf)
minimumItem = List.MinimumItem(list=getItemAtIndex)
watch = Watch(minimumItem)
code_block_6 = CodeBlock { 256; }
