# Dynamo graph 블랙잭.dyn (Dynamo 2.16.1.2727)

code_block = CodeBlock { "5 21"; "5 6 7 8 9"; }
join = List.Join(list0=code_block.out0, list1=code_block.out1)
code_block_2 = CodeBlock { "10 500"; "93 181 245 214 315 36 185 138 216 295"; }
join_2 = List.Join(list0=code_block_2.out0, list1=code_block_2.out1)
code_block_3 = CodeBlock { " "; }
split = String.Split(string=join_2, separator0=code_block_3)
toNumber = String.ToNumber(string=split)
deconstruct = List.Deconstruct(list=toNumber)
lastItem = List.LastItem(list=deconstruct.rest)

# group: 3개 카드 선택 모든 조합 확인
code_block_4 = CodeBlock { 3; }
combinations = List.Combinations(list=lastItem, length=code_block_4)

sum = Math.Sum(values=combinations)

# group: 카드합의 상한선
lastItem_2 = List.LastItem(list=deconstruct.first)

ge = lastItem_2 >= sum
filterByBoolMask = List.FilterByBoolMask(list=sum, mask=ge)
maximumItem = List.MaximumItem(list=filterByBoolMask.in)
watch = Watch(maximumItem)
