# Dynamo graph 사분면 고르기.dyn (Dynamo 2.13.1.3887)

code_block = CodeBlock { 12; 5; }
boolean = BoolSelector(true)
string_from_object = FromObject(object=boolean)
boolean_2 = BoolSelector(false)
string_from_object_2 = FromObject(object=boolean_2)
code_block_2 = CodeBlock(a=string_from_object, b=string_from_object_2)
# ---------- code_block_2.designscript (8 lines) ----------
a;
b;
[
a+"-"+a,
b+"-"+a,
b+"-"+b,
a+"-"+b
];
# ----------------------------------------
code_block_3 = CodeBlock { 1..4; }
byKeysValues = DesignScript.Builtin.Dictionary.ByKeysValues(keys=code_block_2.out2, values=code_block_3)
code_block_4 = CodeBlock { 9; -13; }
code_block_5 = CodeBlock(x=code_block_4.out0, y=code_block_4.out1) { x; y; }
code_block_6 = CodeBlock { 0; }
gt = code_block_5.x > code_block_6
code_block_7 = CodeBlock { 0; }
gt_2 = code_block_5.y > code_block_7
code_block_8 = CodeBlock(x=gt, y=gt_2) { x+"-"+y; }
valueAtKey = DesignScript.Builtin.Dictionary.ValueAtKey(dictionary=byKeysValues, key=code_block_8)
watch = Watch(valueAtKey)
