# Dynamo graph 사칙연산.dyn (Dynamo 2.13.1.3887)

code_block = CodeBlock { 7; 3; }
code_block_2 = CodeBlock(a=code_block.out0, b=code_block.out1) { a + b; a - b; a * b; Math.Floor(a / b); a % b; }
join = List.Join(list0=code_block_2.out0, list1=code_block_2.out1, list2=code_block_2.out2, list3=code_block_2.out3, list4=code_block_2.out4)
watch = Watch(join)
