# Dynamo graph 삼각형 외우기.dyn (Dynamo 2.16.1.2727)

code_block = CodeBlock()
# ---------- code_block.designscript (3 lines) ----------
"60
60
60";
# ----------------------------------------
code_block_2 = CodeBlock()
# ---------- code_block_2.designscript (6 lines) ----------
{
"3": "Scalene",
"2": "Isosceles",
"1": "Equilateral",
"er": "Error"
};
# ----------------------------------------
code_block_3 = CodeBlock()
# ---------- code_block_3.designscript (3 lines) ----------
"60
70
50";
# ----------------------------------------
code_block_4 = CodeBlock { "\n"; }
split = String.Split(string=code_block_3, separator0=code_block_4)
toNumber = String.ToNumber(string=split)
sum = Math.Sum(values=toNumber)
code_block_5 = CodeBlock { 180; }
ne = sum != code_block_5
code_block_6 = CodeBlock { "er"; }
uniqueItems = List.UniqueItems(list=toNumber)
count = List.Count(list=uniqueItems)
string_from_object = FromObject(object=count)
if_ = RefactoredIf(test=ne, true=code_block_6, false=string_from_object)
string_from_object_2 = FromObject(object=if_)
valueAtKey = DesignScript.Builtin.Dictionary.ValueAtKey(dictionary=code_block_2, key=string_from_object_2)
watch = Watch(valueAtKey)
code_block_7 = CodeBlock()
# ---------- code_block_7.designscript (3 lines) ----------
"30
75
75";
# ----------------------------------------
code_block_8 = CodeBlock()
# ---------- code_block_8.designscript (3 lines) ----------
"30
75
85";
# ----------------------------------------
