# Dynamo graph 상수.dyn (Dynamo 2.13.1.3887)

code_block = CodeBlock { "734 893"; "221 231"; "839 237"; }
code_block_2 = CodeBlock { " "; }
split = String.Split(string=code_block.out2, separator0=code_block_2)
code_block_3 = CodeBlock { ""; }
split_2 = String.Split(string=split, separator0=code_block_3)
reverse = List.Reverse(list=split_2@L2)
concat = String.Concat(string0=reverse)
firstItem = List.FirstItem(list=concat)
toNumber = String.ToNumber(string=firstItem)
firstItem_2 = List.FirstItem(list=toNumber)
lastItem = List.LastItem(list=toNumber)
gt = firstItem_2 > lastItem
if_ = RefactoredIf(test=gt, true=firstItem_2, false=lastItem)
watch = Watch(if_)
