# Dynamo graph 색종이.dyn (Dynamo 2.13.1.3887)

code_block = CodeBlock { "3"; "3 7"; "15 7"; "5 2"; }
join = List.Join(list0=code_block.out0, list1=code_block.out1, list2=code_block.out2, list3=code_block.out3)
code_block_2 = CodeBlock(i=join) { i; }
code_block_3 = CodeBlock { " "; }
split = String.Split(string=code_block_2, separator0=code_block_3)
toNumber = String.ToNumber(string=split)
deconstruct = List.Deconstruct(list=toNumber)
firstItem = List.FirstItem(list=deconstruct.first)
code_block_4 = CodeBlock { 10; }
code_block_5 = CodeBlock(색종이_가로=code_block_4, 색종이_세로=code_block_4) { 색종이_가로; 색종이_세로; }
mul = code_block_5.색종이_가로 * code_block_5.색종이_세로
mul_2 = firstItem * mul
code_block_6 = CodeBlock(totalArea=mul_2) { totalArea; }
code_block_7 = CodeBlock(색종이_가로=code_block_5.색종이_가로, 색종이_세로=code_block_5.색종이_세로) { 색종이_가로; 색종이_세로; }
code_block_8 = CodeBlock { 2; }
# note: 겹침 영역 계산
# (미니멈 포인트 좌표가 동일할 경우 겹침도 100%)
# (색종이 가로 - 미니멈 포인트 x좌표 차이) * (색종이 세로 - 미니멈 포인트 y 좌표 차이) = 겹침 영역 넓이
combinations = List.Combinations(list=deconstruct.rest, length=code_block_8)
firstItem_2 = List.FirstItem(list=combinations@@L2)
firstItem_3 = List.FirstItem(list=firstItem_2@@L2)
lastItem = List.LastItem(list=firstItem_2@@L2)
sub = firstItem_3 - lastItem
abs = Math.Abs(number=sub)
sub_2 = code_block_7.색종이_가로 - abs
code_block_9 = CodeBlock { 0; }
gt = sub_2 > code_block_9
code_block_10 = CodeBlock { 0; }
if_ = RefactoredIf(test=gt@L1, true=sub_2@L1, false=code_block_10)
lastItem_2 = List.LastItem(list=combinations@@L2)
firstItem_4 = List.FirstItem(list=lastItem_2@@L2)
lastItem_3 = List.LastItem(list=lastItem_2@@L2)
sub_3 = firstItem_4 - lastItem_3
abs_2 = Math.Abs(number=sub_3)
sub_4 = code_block_7.색종이_세로 - abs_2
code_block_11 = CodeBlock { 0; }
gt_2 = sub_4 > code_block_11
code_block_12 = CodeBlock { 0; }
if_2 = RefactoredIf(test=gt_2@L1, true=sub_4@L1, false=code_block_12)
mul_3 = if_ * if_2
sum = Math.Sum(values=mul_3)
sub_5 = code_block_6 - sum
watch = Watch(sub_5)
