# Dynamo graph 서로 다른 부분 문자열의 개수.dyn (Dynamo 2.16.1.2727)

code_block = CodeBlock { "ababc"; }
code_block_2 = CodeBlock { ""; }
split = String.Split(string=code_block, separator0=code_block_2)
code_block_3 = CodeBlock { 0; }
code_block_4 = CodeBlock { 1; }
count = List.Count(list=split)
range = Range(start=code_block_4, end=count)
code_block_5 = CodeBlock { 1; }
sub = range - code_block_5
range_2 = Range(start=code_block_3, end=sub)
code_block_6 = CodeBlock { 1; }
sublists = List.Sublists(list=split, ranges=range_2@L2, offset=code_block_6)
count_2 = List.Count(list=sublists@L2)
count_3 = List.Count(list=sublists@L3)
chop = List.Chop(list=count_2, lengths=count_3)
maximumItem = List.MaximumItem(list=chop)
eq = chop == maximumItem
filterByBoolMask = List.FilterByBoolMask(list=sublists, mask=eq)
code_block_7 = CodeBlock(i=filterByBoolMask.in) { i; }
flatten = List.Flatten(list=code_block_7@L2)
concat = String.Concat(string0=flatten)
flatten_2 = List.Flatten(list=concat)
uniqueItems = List.UniqueItems(list=flatten_2)
count_4 = List.Count(list=uniqueItems)
watch = Watch(count_4)
