# Dynamo graph 설탕 배달.dyn (Dynamo 2.13.1.3887)

code_block = CodeBlock { 3; 5; }
code_block_2 = CodeBlock { 18; 4; 6; 9; 11; }
code_block_3 = CodeBlock(i=code_block_2.out4) { i; }
div = code_block_3 / code_block.out0
range = Range(end=div)
mul = code_block.out0 * range
list_create = List.Create(item0=mul, item1=range)
transpose = List.Transpose(lists=list_create)
firstItem = List.FirstItem(list=transpose@L2)
mul_2 = code_block.out1 * range
list_create_2 = List.Create(item0=mul_2, item1=range)
transpose_2 = List.Transpose(lists=list_create_2)
firstItem_2 = List.FirstItem(list=transpose_2@L2)
add = firstItem + firstItem_2  # lacing=CrossProduct
eq = add == code_block_3
anyTrue = List.AnyTrue(list=eq@L2)
boolean = BoolSelector(true)
allIndicesOf = List.AllIndicesOf(list=anyTrue, item=boolean)
getItemAtIndex = List.GetItemAtIndex(list=eq, index=allIndicesOf)
anyTrue_2 = List.AnyTrue(list=getItemAtIndex@L1)
allFalse = List.AllFalse(list=anyTrue_2)
isEmpty = List.IsEmpty(list=allIndicesOf)
code_block_4 = CodeBlock { [0]; }
if_ = RefactoredIf(test=isEmpty, true=code_block_4, false=allIndicesOf)
firstItem_3 = List.FirstItem(list=if_)
boolean_2 = BoolSelector(true)
allIndicesOf_2 = List.AllIndicesOf(list=anyTrue_2, item=boolean_2)
isEmpty_2 = List.IsEmpty(list=allIndicesOf_2)
firstItem_4 = List.FirstItem()  # unwired: list
function_apply = ApplyFunction(function=firstItem_4, argument0=allIndicesOf_2)
if_2 = RefactoredIf(test=isEmpty_2, true=allIndicesOf_2, false=function_apply)
add_2 = firstItem_3 + if_2
isEmpty_3 = List.IsEmpty(list=add_2)
code_block_5 = CodeBlock { -1; }
if_3 = RefactoredIf(test=isEmpty_3, true=code_block_5, false=add_2)
watch = Watch(if_3)
