# Dynamo graph 소수 찾기.dyn (Dynamo 2.13.1.3887)

code_block = CodeBlock()
# ---------- code_block.designscript (2 lines) ----------
[4,
"1 3 5 7"];
# ----------------------------------------
code_block_2 = CodeBlock()
# ---------- code_block_2.designscript (2 lines) ----------
[4,
"1 4 8 16"];
# ----------------------------------------
code_block_3 = CodeBlock()
# ---------- code_block_3.designscript (2 lines) ----------
[4,
"1 4 8 999777"];
# ----------------------------------------
code_block_4 = CodeBlock()
# ---------- code_block_4.designscript (2 lines) ----------
[4,
"1 3 4 9"];
# ----------------------------------------
deconstruct = List.Deconstruct(list=code_block_4)
code_block_5 = CodeBlock { " "; }
split = String.Split(string=deconstruct.rest, separator0=code_block_5)
flatten = List.Flatten(list=split)
toNumber = String.ToNumber(string=flatten)
maximumItem = List.MaximumItem(list=toNumber)

# group: 2~N 까지 소수 찾기
code_block_6 = CodeBlock { 1; }
code_block_7 = CodeBlock { 2; }
code_block_8 = CodeBlock(i=maximumItem) { i; }
range = Range(start=code_block_7, end=code_block_8)
range_2 = Range(start=range, end=code_block_8, step=range)
deconstruct_2 = List.Deconstruct(list=range_2@L2)
flatten_2 = List.Flatten(list=deconstruct_2.rest)
uniqueItems = List.UniqueItems(list=flatten_2)
sort = List.Sort(list=uniqueItems)
addItemToFront = List.AddItemToFront(item=code_block_6, list=sort)

contains = List.Contains(list=addItemToFront, item=toNumber@L1)
filterByBoolMask = List.FilterByBoolMask(list=toNumber, mask=contains)
count = List.Count(list=filterByBoolMask.out)
watch = Watch(count)
