# Dynamo graph 소수.dyn (Dynamo 2.13.1.3887)

code_block = CodeBlock { 60; 100; }
join = List.Join(list0=code_block.out0, list1=code_block.out1)
소수_파이썬_풀이 = Python(IN[0]=join)  # CPython3
# ---------- 소수_파이썬_풀이.python (29 lines) ----------
# Load the Python Standard and DesignScript Libraries
import sys
import clr
clr.AddReference('ProtoGeometry')
from Autodesk.DesignScript.Geometry import *
import copy

# The inputs to this node will be stored as a list in the IN variables.
dataEnteringNode = IN
inputs = IN[0]
# Place your code below this line


def prime_list(start, n):
    # 에라토스테네스의 체 초기화: n개 요소에 True 설정(소수로 간주)
    sieve = [True] * n

    # n의 최대 약수가 sqrt(n) 이하이므로 i=sqrt(n)까지 검사
    m = int(n ** 0.5)
    for i in range(2, m + 1):
        if sieve[i] == True:           # i가 소수인 경우
            for j in range(i+i, n, i): # i이후 i의 배수들을 False 판정
                sieve[j] = False

    # 소수 목록 산출
    return [i for i in range(start, n) if sieve[i] == True]

# Assign your output to the OUT variable.
OUT = prime_list(*inputs)
# ----------------------------------------

# group: 입력 범위 내 숫자
deconstruct = List.Deconstruct(list=join)
code_block_2 = CodeBlock(i=deconstruct.rest) { i[0]; }
code_block_3 = CodeBlock(i=code_block_2) { i==1; }
code_block_4 = CodeBlock(i=code_block_2) { i; i-1; }
if_ = RefactoredIf(test=code_block_3, true=code_block_4.i, false=code_block_4.i, lacing=Shortest)
range = Range(start=deconstruct.first, end=if_)

# group: 2~N 까지 소수 찾기
code_block_5 = CodeBlock { 1; }
code_block_6 = CodeBlock { 2; }
code_block_7 = CodeBlock(i=deconstruct.rest) { i[0]; }
range_2 = Range(start=code_block_6, end=code_block_7)
range_3 = Range(start=range_2, end=code_block_7, step=range_2)
deconstruct_2 = List.Deconstruct(list=range_3@L2)
flatten = List.Flatten(list=deconstruct_2.rest)
uniqueItems = List.UniqueItems(list=flatten)
sort = List.Sort(list=uniqueItems)
addItemToFront = List.AddItemToFront(item=code_block_5, list=sort)

contains = List.Contains(list=addItemToFront, item=range@L1)
filterByBoolMask = List.FilterByBoolMask(list=range, mask=contains)
isEmpty = List.IsEmpty(list=filterByBoolMask.out)
code_block_8 = CodeBlock { -1; }
sum = Math.Sum(values=filterByBoolMask.out)
if_2 = RefactoredIf(test=isEmpty, true=code_block_8, false=sum)
minimumItem = List.MinimumItem(list=filterByBoolMask.out)
isNull = Object.IsNull(object=minimumItem)
code_block_9 = CodeBlock { "null"; }
if_3 = RefactoredIf(test=isNull, true=code_block_9, false=minimumItem)
join_2 = List.Join(list0=if_2, list1=if_3)
allIndicesOf = List.AllIndicesOf(list=join_2, item=code_block_9)
removeItemAtIndex = List.RemoveItemAtIndex(list=join_2, indices=allIndicesOf)
watch = Watch(removeItemAtIndex)
code_block_10 = CodeBlock { 25; 27; }
