# Dynamo graph 소인수분해.dyn (Dynamo 2.13.1.3887)

code_block = CodeBlock { 2; }
code_block_2 = CodeBlock { 72; 3; 6; 2; 9991; 90; }
code_block_3 = CodeBlock(i=code_block_2.out4) { i; }
range = Range(start=code_block, end=code_block_3)

# group: 2~N 까지 소수 찾기
code_block_4 = CodeBlock { 1; }
code_block_5 = CodeBlock { 2; }
code_block_6 = CodeBlock(i=code_block_3) { i; }
range_2 = Range(start=code_block_5, end=code_block_6)

sqrt = Math.Sqrt(number=code_block_6)
ceiling = Math.Ceiling(number=sqrt)

# group (continued): 2~N 까지 소수 찾기
range_3 = Range(start=range_2, end=ceiling, step=range_2)
deconstruct = List.Deconstruct(list=range_3@L2)
flatten = List.Flatten(list=deconstruct.rest)
uniqueItems = List.UniqueItems(list=flatten)
sort = List.Sort(list=uniqueItems)
addItemToFront = List.AddItemToFront(item=code_block_4, list=sort)

contains = List.Contains(list=addItemToFront, item=range@L1)
filterByBoolMask = List.FilterByBoolMask(list=range, mask=contains)
code_block_7 = CodeBlock(i=filterByBoolMask.out) { i; }
code_block_8 = CodeBlock(i=code_block_3) { i; }
mod = code_block_8 % code_block_7
code_block_9 = CodeBlock(i=mod) { i == 0; }
filterByBoolMask_2 = List.FilterByBoolMask(list=code_block_7, mask=code_block_9)
count = List.Count(list=filterByBoolMask_2.in)
code_block_10 = CodeBlock { " "; }
소인수_목록 = CodeBlock(i=filterByBoolMask_2.in) { i; }
code_block_11 = CodeBlock(i=code_block_8) { i; }
list_create = List.Create()  # unwired: item0, item1
code_block_12 = CodeBlock { 1; }
code_block_13 = CodeBlock(i=code_block_8) { i; }
sqrt_2 = Math.Sqrt(number=code_block_13)
ceiling_2 = Math.Ceiling(number=sqrt_2)
sqrt_3 = Math.Sqrt(number=ceiling_2)
ceiling_3 = Math.Ceiling(number=sqrt_3)
range_4 = Range(start=code_block_12, end=ceiling_3)
cartesianProduct = List.CartesianProduct(combineFunction=list_create, list0=filterByBoolMask_2.in, list1=range_4)
firstItem = List.FirstItem(list=cartesianProduct@@L2)
lastItem = List.LastItem(list=cartesianProduct@@L2)
pow = Math.Pow(number=firstItem, power=lastItem)
mod_2 = code_block_11 % pow
code_block_14 = CodeBlock { 0; }
eq = mod_2 == code_block_14
filterByBoolMask_3 = List.FilterByBoolMask(list=mod_2, mask=eq)
count_2 = List.Count(list=filterByBoolMask_3.in@L2)
ofRepeatedItem = List.OfRepeatedItem(item=소인수_목록, amount=count_2, lacing=Shortest)
string_from_object = FromObject(object=ofRepeatedItem)
join = String.Join(separator=code_block_10, string0=string_from_object)
watch = Watch(ofRepeatedItem)
le = pow <= code_block_11
filterByBoolMask_4 = List.FilterByBoolMask(list=pow@L2, mask=le@L2)
