# Dynamo graph 소인수분해_2.dyn (Dynamo 2.13.1.3887)

code_block = CodeBlock { 72; 3; 6; 2; 9991; 90; 9992; 1249; 1; }
code_block_2 = CodeBlock(i=code_block.out4) { i==1; i; }
code_block_3 = CodeBlock { []; }
if_ = RefactoredIf(test=code_block_2.out0, true=code_block_3, false=code_block_2.i)

# group: 소인수 찾기
code_block_4 = CodeBlock { 1; }
code_block_5 = CodeBlock(i=if_) { i; }
range = Range(start=code_block_4, end=code_block_5)
code_block_6 = CodeBlock(i=range) { i!=1? true:false; }
filterByBoolMask = List.FilterByBoolMask(list=range, mask=code_block_6)
mod = code_block_5 % filterByBoolMask.in
code_block_7 = CodeBlock { 0; }
eq = mod == code_block_7
filterByBoolMask_2 = List.FilterByBoolMask(list=filterByBoolMask.in, mask=eq)
watch = Watch(filterByBoolMask_2.in)
code_block_8 = CodeBlock(i=code_block_5) { i; }
range_2 = Range(start=watch, end=code_block_8, step=watch)
isEmpty = List.IsEmpty(list=range_2)
code_block_9 = CodeBlock { 2; }
code_block_10 = CodeBlock(i=range_2) { i; }
if_2 = RefactoredIf(test=isEmpty, true=code_block_9, false=code_block_10)
deconstruct = List.Deconstruct(list=if_2@L2)
flatten = List.Flatten(list=deconstruct.rest)
uniqueItems = List.UniqueItems(list=flatten)
sort = List.Sort(list=uniqueItems)
contains = List.Contains(list=sort, item=filterByBoolMask_2.in@L1)
filterByBoolMask_3 = List.FilterByBoolMask(list=filterByBoolMask_2.in, mask=contains)
code_block_11 = CodeBlock(primeNum=filterByBoolMask_3.out) { primeNum; }

code_block_12 = CodeBlock { 1; }
code_block_13 = CodeBlock(i=code_block_8) { i; }
sqrt = Math.Sqrt(number=code_block_13)
sqrt_2 = Math.Sqrt(number=sqrt)
ceiling = Math.Ceiling(number=sqrt_2)
range_3 = Range(start=code_block_12, end=ceiling)
# note: 소인수들 제곱 가능 경우의수
pow = Math.Pow(number=code_block_11, power=range_3, lacing=CrossProduct)
code_block_14 = CodeBlock(i=code_block_13) { i; }
le = pow <= code_block_14
# note: 그중 본 수보다 큰 수 제거
filterByBoolMask_4 = List.FilterByBoolMask(list=pow@L2, mask=le@L2)
mod_2 = code_block_14 % filterByBoolMask_4.in
code_block_15 = CodeBlock(i=mod_2) { i==0; }
# note: 그중 약수가 아닌 것 제거
filterByBoolMask_5 = List.FilterByBoolMask(list=filterByBoolMask_4.in, mask=code_block_15)
isEmpty_2 = List.IsEmpty(list=filterByBoolMask_5.in)
code_block_16 = CodeBlock { 2; }
code_block_17 = CodeBlock(i=filterByBoolMask_5.in) { i; }
if_3 = RefactoredIf(test=isEmpty_2, true=code_block_16, false=code_block_17)
firstItem = List.FirstItem(list=if_3@L2)
count = List.Count(list=filterByBoolMask_5.in@L2)
ofRepeatedItem = List.OfRepeatedItem(item=firstItem@L1, amount=count@L1)
watch_2 = Watch(ofRepeatedItem)
