# Dynamo graph 소트인사이드.dyn (Dynamo 2.16.1.2727)

code_block = CodeBlock { 2143; }
code_block_2 = CodeBlock { 500613009; }
string_from_object = FromObject(object=code_block_2)
code_block_3 = CodeBlock { ""; }
split = String.Split(string=string_from_object, separator0=code_block_3)
toNumber = String.ToNumber(string=split)
code_block_4 = CodeBlock { 0; }
sub = code_block_4 - _  # unwired: y
sortByFunction = List.SortByFunction(list=toNumber, sortFunction=sub)
string_from_object_2 = FromObject(object=sortByFunction)
concat = String.Concat(string0=string_from_object_2)
watch = Watch(concat)
code_block_5 = CodeBlock { 999998999; }
code_block_6 = CodeBlock { 61423; }
