# Dynamo graph 손익분기점.dyn (Dynamo 2.13.1.3887)

code_block = CodeBlock { ["A", "B", "C"]; }
code_block_2 = CodeBlock { "1000 70 170"; "3 2 1"; "2100000000 9 10"; }
code_block_3 = CodeBlock { " "; }
split = String.Split(string=code_block_2.out2, separator0=code_block_3)
toNumber = String.ToNumber(string=split)
byKeysValues = DesignScript.Builtin.Dictionary.ByKeysValues(keys=code_block, values=toNumber)
code_block_4 = CodeBlock { "A"; }
valueAtKey = DesignScript.Builtin.Dictionary.ValueAtKey(dictionary=byKeysValues, key=code_block_4)
code_block_5 = CodeBlock { "C"; }
valueAtKey_2 = DesignScript.Builtin.Dictionary.ValueAtKey(dictionary=byKeysValues, key=code_block_5)
code_block_6 = CodeBlock { "B"; }
valueAtKey_3 = DesignScript.Builtin.Dictionary.ValueAtKey(dictionary=byKeysValues, key=code_block_6)
sub = valueAtKey_2 - valueAtKey_3
div = valueAtKey / sub
# note: A + B * X > C * X
# A > (C-B) * X
# A / (C-B)
code_block_7 = CodeBlock(i=div) { i+1; }
code_block_8 = CodeBlock { 0; }
gt = code_block_7 > code_block_8
code_block_9 = CodeBlock { -1; }
if_ = RefactoredIf(test=gt, true=code_block_7, false=code_block_9)
watch = Watch(if_)
