# Dynamo graph 수 정렬하기.dyn (Dynamo 2.13.1.3887)

code_block = CodeBlock()
# ---------- code_block.designscript (8 lines) ----------
[
5,
5,
2,
3,
4,
1
];
# ----------------------------------------
deconstruct = List.Deconstruct(list=code_block)
sort = List.Sort(list=deconstruct.rest)
watch = Watch(sort)
