# Dynamo graph 수학은 체육과목 입니다.dyn (Dynamo 2.16.1.2727)

code_block = CodeBlock { 1; }
code_block_2 = CodeBlock { 4; }
code_block_3 = CodeBlock { 3; }
code_block_4 = CodeBlock { 1; -1; }
range = Range(start=code_block_3, end=code_block_4.out0, step=code_block_4.out1)
mul = code_block_2 * range
sum = Math.Sum(values=mul)
code_block_5 = CodeBlock { 1; }
sub = range - code_block_5
code_block_6 = CodeBlock { 4; }
mul_2 = sub * code_block_6
sum_2 = Math.Sum(values=mul_2)
sub_2 = sum - sum_2
watch = Watch(sub_2)
