# Dynamo graph 숫자 카드.dyn (Dynamo 2.16.1.2727)

code_block = CodeBlock { " "; }
code_block_2 = CodeBlock()
# ---------- code_block_2.designscript (2 lines) ----------
{"true": "1",
"false": "0"};
# ----------------------------------------
code_block_3 = CodeBlock()
# ---------- code_block_3.designscript (4 lines) ----------
"5
6 3 2 10 -10
8
10 9 -5 2 3 4 5 -10";
# ----------------------------------------
code_block_4 = CodeBlock { "\n"; }
split = String.Split(string=code_block_3, separator0=code_block_4)
code_block_5 = CodeBlock { " "; }
split_2 = String.Split(string=split, separator0=code_block_5)
toNumber = String.ToNumber(string=split_2)
code_block_6 = CodeBlock { [1,3]; }
getItemAtIndex = List.GetItemAtIndex(list=toNumber, index=code_block_6)
firstItem = List.FirstItem(list=getItemAtIndex)
lastItem = List.LastItem(list=getItemAtIndex)
contains = List.Contains(list=firstItem, item=lastItem@L1)
string_from_object = FromObject(object=contains)
valueAtKey = DesignScript.Builtin.Dictionary.ValueAtKey(dictionary=code_block_2, key=string_from_object)
join = String.Join(separator=code_block, string0=valueAtKey)
watch = Watch(join)
