# Dynamo graph 숫자의 합.dyn (Dynamo 2.13.1.3887)

code_block = CodeBlock { 1; 1; }
code_block_2 = CodeBlock { 5; 54321; }
code_block_3 = CodeBlock { 11; 10987654321; }
code_block_4 = CodeBlock { 25; "7000000000000000000000000"; 7000000000000000000000000; }
string_from_object = FromObject(object=code_block_4.out1)
code_block_5 = CodeBlock { ""; }
split = String.Split(string=string_from_object, separator0=code_block_5)
toNumber = String.ToNumber(string=split)
sum = Math.Sum(values=toNumber)
watch = Watch(sum)
toNumber_2 = String.ToNumber(string=code_block_4.out1)
python_script = Python(IN[0]=code_block_4.out1)  # CPython3
# ---------- python_script.python (18 lines) ----------
# Load the Python Standard and DesignScript Libraries
import sys
import clr
clr.AddReference('ProtoGeometry')
from Autodesk.DesignScript.Geometry import *

# The inputs to this node will be stored as a list in the IN variables.
dataEnteringNode = IN
input = IN[0]
# Place your code below this line

num = int(input)

def split_num(num):
    return list(map(int, str(num)))

# Assign your output to the OUT variable.
OUT = num
# ----------------------------------------
