# Dynamo graph 시험 성적.dyn (Dynamo 2.13.1.3887)

code_block = CodeBlock()
# ---------- code_block.designscript (7 lines) ----------
[
4,
3,
2,
1,
0
];
# ----------------------------------------
string_from_object = FromObject(object=code_block)
code_block_2 = CodeBlock()
# ---------- code_block_2.designscript (7 lines) ----------
[
"A",
"B",
"C",
"D",
"F"
];
# ----------------------------------------
byKeysValues = DesignScript.Builtin.Dictionary.ByKeysValues(keys=string_from_object, values=code_block_2)
test_case = CodeBlock { 95; 89; 70; 69; 40; }
code_block_3 = CodeBlock()
# ---------- code_block_3.designscript (6 lines) ----------
[
60,
70,
80,
90
];
# ----------------------------------------
ge = test_case.out2 >= code_block_3
countTrue = List.CountTrue(list=ge)
string_from_object_2 = FromObject(object=countTrue)
valueAtKey = DesignScript.Builtin.Dictionary.ValueAtKey(dictionary=byKeysValues, key=string_from_object_2)
watch = Watch(valueAtKey)
code_block_4 = CodeBlock { 100; }
