# Dynamo graph 아스키 코드.dyn (Dynamo 2.13.1.3887)

code_block = CodeBlock { "A"; "C"; "0"; "9"; "a"; "z"; }
python_script = Python(IN[0]=code_block.out5)  # CPython3
# ---------- python_script.python (15 lines) ----------
# Load the Python Standard and DesignScript Libraries
import sys
import clr
clr.AddReference('ProtoGeometry')
from Autodesk.DesignScript.Geometry import *

# The inputs to this node will be stored as a list in the IN variables.
dataEnteringNode = IN
inStr = IN[0]
# Place your code below this line



# Assign your output to the OUT variable.
OUT = ord(inStr)
# ----------------------------------------
watch = Watch(python_script)
