# Dynamo graph 알람 시계.dyn (Dynamo 2.13.1.3887)

code_block = CodeBlock { 10; 10; }
code_block_2 = CodeBlock { 0; 30; }
code_block_3 = CodeBlock { 23; 40; }
code_block_4 = CodeBlock(H=code_block_3.out0, M=code_block_3.out1) { H; M; }
code_block_5 = CodeBlock { 45; }
sub = code_block_4.M - code_block_5
code_block_6 = CodeBlock { 0; }
lt = sub < code_block_6
code_block_7 = CodeBlock(H=code_block_4.H, M=sub)
# ---------- code_block_7.designscript (4 lines) ----------
[
H-1,
60+M
];
# ----------------------------------------
code_block_8 = CodeBlock(H=code_block_4.H, M=sub)
# ---------- code_block_8.designscript (3 lines) ----------
[
H,M
];
# ----------------------------------------
if_ = RefactoredIf(test=lt, true=code_block_7, false=code_block_8)
code_block_9 = CodeBlock(i=if_)
# ---------- code_block_9.designscript (6 lines) ----------
H = i[0];
M = i[1];
[
24+H,
M
];
# ----------------------------------------
code_block_10 = CodeBlock { 0; }
lt_2 = code_block_9.H < code_block_10
code_block_11 = CodeBlock(i=if_) { i; }
if_2 = RefactoredIf(test=lt_2, true=code_block_9.out2, false=code_block_11)
watch = Watch(if_2)
