# Dynamo graph 알파벳 찾기.dyn (Dynamo 2.13.1.3887)

code_block = CodeBlock { 97; 122; }
range = Range(start=code_block.out0, end=code_block.out1)
python_script = Python(IN[0]=range)  # CPython3
# ---------- python_script.python (15 lines) ----------
# Load the Python Standard and DesignScript Libraries
import sys
import clr
clr.AddReference('ProtoGeometry')
from Autodesk.DesignScript.Geometry import *

# The inputs to this node will be stored as a list in the IN variables.
dataEnteringNode = IN
inputs = IN[0]
# Place your code below this line

res = map(chr, inputs)

# Assign your output to the OUT variable.
OUT = res
# ----------------------------------------
code_block_2 = CodeBlock { " "; }
code_block_3 = CodeBlock { "baekjoon"; }
code_block_4 = CodeBlock()
# ---------- code_block_4.designscript (8 lines) ----------
[
"a", "b", "c", "d", "e",
"f", "g", "h", "i", "j",
"k", "l", "m", "n", "o",
"p", "q", "r", "s", "t",
"u", "v", "w", "x", "y",
"z"
];
# ----------------------------------------
indexOf = String.IndexOf(string=code_block_3, searchFor=code_block_4)
string_from_object = FromObject(object=indexOf)
join = String.Join(separator=code_block_2, string0=string_from_object)
watch = Watch(join)
