# Dynamo graph 영단어 암기는 괴로워.dyn (Dynamo 2.16.1.2727)

code_block = CodeBlock()
# ---------- code_block.designscript (8 lines) ----------
"7 4
apple
ant
sand
apple
append
sand
sand";
# ----------------------------------------
code_block_2 = CodeBlock()
# ---------- code_block_2.designscript (13 lines) ----------
"12 5
appearance
append
attendance
swim
swift
swift
swift
mouse
wallet
mouse
ice
age";
# ----------------------------------------
code_block_3 = CodeBlock(input=code_block_2) { input; }
code_block_4 = CodeBlock { "\n"; }
split = String.Split(string=code_block_3, separator0=code_block_4)
deconstruct = List.Deconstruct(list=split)
length = String.Length(string=deconstruct.rest)
code_block_5 = CodeBlock { " "; }
split_2 = String.Split(string=deconstruct.first, separator0=code_block_5)
toNumber = String.ToNumber(string=split_2)
lastItem = List.LastItem(list=toNumber)
ge = length >= lastItem
filterByBoolMask = List.FilterByBoolMask(list=deconstruct.rest, mask=ge)
groupByKey = List.GroupByKey(list=filterByBoolMask.in, keys=filterByBoolMask.in)
count = List.Count(list=groupByKey.groups@L2)
groupByKey_2 = List.GroupByKey(list=groupByKey.uniqueKeys, keys=count)
sortIndexByValue = List.SortIndexByValue(list=groupByKey_2.uniqueKeys)
reverse = List.Reverse(list=sortIndexByValue)
getItemAtIndex = List.GetItemAtIndex(list=groupByKey_2.groups, index=reverse)
length_2 = String.Length(string=getItemAtIndex)
groupByKey_3 = List.GroupByKey(list=getItemAtIndex@L2, keys=length_2@L2)
code_block_6 = CodeBlock(i=groupByKey_3.groups) { i; }
sort = List.Sort(list=code_block_6@L2)
flatten = List.Flatten(list=sort)
watch = Watch(flatten)
