# Dynamo graph 영단어 암기는 괴로워.dyn (Dynamo 2.16.1.2727)

code_block = CodeBlock()
# ---------- code_block.designscript (11 lines) ----------
"7 4
apple
ant
sand
apple
append
sand
sand
aaaaa
aaaaa
aaaaa";
# ----------------------------------------
code_block_2 = CodeBlock(input=code_block) { input; }
code_block_3 = CodeBlock { "\n"; }
split = String.Split(string=code_block_2, separator0=code_block_3)
deconstruct = List.Deconstruct(list=split)
length = String.Length(string=deconstruct.rest)
code_block_4 = CodeBlock { " "; }
split_2 = String.Split(string=deconstruct.first, separator0=code_block_4)
toNumber = String.ToNumber(string=split_2)
lastItem = List.LastItem(list=toNumber)
ge = length >= lastItem
filterByBoolMask = List.FilterByBoolMask(list=deconstruct.rest, mask=ge)
groupByKey = List.GroupByKey(list=filterByBoolMask.in, keys=filterByBoolMask.in)
count = List.Count(list=groupByKey.groups@L2)
sortIndexByValue = List.SortIndexByValue(list=count)
reverse = List.Reverse(list=sortIndexByValue)
getItemAtIndex = List.GetItemAtIndex(list=groupByKey.uniqueKeys, index=reverse)
length_2 = String.Length(string=getItemAtIndex)
groupByKey_2 = List.GroupByKey(list=getItemAtIndex, keys=length_2)
sort = List.Sort(list=groupByKey_2.groups)
