# Dynamo graph 영수증.dyn (Dynamo 2.16.1.2727)

code_block = CodeBlock { ["true", "false"]; ["Yes", "No"]; }
byKeysValues = DesignScript.Builtin.Dictionary.ByKeysValues(keys=code_block.out0, values=code_block.out1)
code_block_2 = CodeBlock { 260000; 4; "20000 5"; "30000 2"; "10000 6"; "5000 8"; }
join = List.Join(list0=code_block_2.out0, list1=code_block_2.out1, list2=code_block_2.out2, list3=code_block_2.out3, list4=code_block_2.out4, list5=code_block_2.out5)
deconstruct = List.Deconstruct(list=join)
code_block_3 = CodeBlock(bill=deconstruct.first) { bill; }
deconstruct_2 = List.Deconstruct(list=deconstruct.rest)
code_block_4 = CodeBlock { " "; }
split = String.Split(string=deconstruct_2.rest, separator0=code_block_4)
firstItem = List.FirstItem(list=split@L2)
toNumber = String.ToNumber(string=firstItem)
lastItem = List.LastItem(list=split@L2)
toNumber_2 = String.ToNumber(string=lastItem)
mul = toNumber * toNumber_2
sum = Math.Sum(values=mul)
eq = code_block_3 == sum
string_from_object = FromObject(object=eq)
valueAtKey = DesignScript.Builtin.Dictionary.ValueAtKey(dictionary=byKeysValues, key=string_from_object)
watch = Watch(valueAtKey)
code_block_5 = CodeBlock { 250000; 4; "20000 5"; "30000 2"; "10000 6"; "5000 8"; }
join_2 = List.Join(list0=code_block_5.out0, list1=code_block_5.out1, list2=code_block_5.out2, list3=code_block_5.out3, list4=code_block_5.out4, list5=code_block_5.out5)
