# Dynamo graph 영화감독 숌.dyn (Dynamo 2.16.1.2727)

code_block = CodeBlock { 0..10000; }
string_from_object = FromObject(object=code_block)
code_block_2 = CodeBlock { "666"; }
contains = String.Contains(string=string_from_object, searchFor=code_block_2)
filterByBoolMask = List.FilterByBoolMask(list=code_block, mask=contains)
code_block_3 = CodeBlock { 0; 666; }
code_block_4 = CodeBlock { 10001; }
sequence = Sequence(amount=code_block_4)
code_block_5 = CodeBlock { 500; }
python_script = Python(IN[0]=code_block_5)  # CPython3
# ---------- python_script.python (20 lines) ----------
# Load the Python Standard and DesignScript Libraries
import sys
import clr
clr.AddReference('ProtoGeometry')
from Autodesk.DesignScript.Geometry import *

# The inputs to this node will be stored as a list in the IN variables.
dataEnteringNode = IN
n = IN[0]
# Place your code below this line

def get_nthDoomNum(n):
    lazy_list = filter(lambda x: "666" in x,map(str, range(0, 10000*1000)))
    idx = n
    for i,v in enumerate(lazy_list):
        if i+1 is idx:
            return v

# Assign your output to the OUT variable.
OUT = get_nthDoomNum(n)
# ----------------------------------------
