# Dynamo graph 오븐 시계.dyn (Dynamo 2.13.1.3887)

code_block = CodeBlock { 14; 30; 20; }
code_block_2 = CodeBlock { 17; 40; 80; }
code_block_3 = CodeBlock { 23; 48; 25; }
code_block_4 = CodeBlock(A=code_block_3.out0, B=code_block_3.out1, C=code_block_3.out2) { A; B; C; }
add = code_block_4.B + code_block_4.C
code_block_5 = CodeBlock(finMinute=add, A=code_block_4.A)
# ---------- code_block_5.designscript (7 lines) ----------
finMinute;
overHour = Math.Floor(finMinute/60);

[
A+overHour,
finMinute % 60
];
# ----------------------------------------
code_block_6 = CodeBlock(i=code_block_5.out2)
# ---------- code_block_6.designscript (7 lines) ----------
H = i[0];
M = i[1];

[
H-24,
M
];
# ----------------------------------------
code_block_7 = CodeBlock { 24; }
ge = code_block_6.H >= code_block_7
if_ = RefactoredIf(test=ge, true=code_block_6.out2, false=code_block_5.out2)
watch = Watch(if_)
