# Dynamo graph 윤년.dyn (Dynamo 2.13.1.3887)

code_block = CodeBlock { 2000; }
code_block_2 = CodeBlock { 1999; 2016; 2017; }
code_block_3 = CodeBlock(i=code_block_2.out2) { i; }
code_block_4 = CodeBlock { 400; }
mod = code_block_3 % code_block_4
code_block_5 = CodeBlock(x=mod) { !x; }
code_block_6 = CodeBlock { 4; }
mod_2 = code_block_3 % code_block_6
code_block_7 = CodeBlock(x=mod_2) { !x; }
code_block_8 = CodeBlock { 100; }
mod_3 = code_block_3 % code_block_8
and_ = And(bool0=code_block_7, bool1=mod_3)
or_ = Or(bool0=code_block_5, bool1=and_)
code_block_9 = CodeBlock(x=or_) { x == true? 1:0; }
watch = Watch(code_block_9)
test_case = CodeBlock { 1900; 2012; }
