# Dynamo graph 재귀의 귀재.dyn (Dynamo 2.16.1.2727)

code_block = CodeBlock()
# ---------- code_block.designscript (6 lines) ----------
[5,
"AAA",
"ABBA",
"ABABA",
"ABCA",
"PALINDROME"];
# ----------------------------------------
deconstruct = List.Deconstruct(list=code_block)
code_block_2 = CodeBlock(i=deconstruct.rest) { i; }
팔린드롬_체크함수_비재귀 = Python(IN[0]=code_block_2)  # CPython3
# ---------- 팔린드롬_체크함수_비재귀.python (17 lines) ----------
# Load the Python Standard and DesignScript Libraries
import sys
import clr
clr.AddReference('ProtoGeometry')
from Autodesk.DesignScript.Geometry import *

# The inputs to this node will be stored as a list in the IN variables.
dataEnteringNode = IN
s = IN[0]
# Place your code below this line
def palindrome(s):
    res = "".join(reversed(s)) == s
    
    return res

# Assign your output to the OUT variable.
OUT = palindrome(s)
# ----------------------------------------
팔린드롬_체크함수_재귀__전역변수_미사용 = Python(IN[0]=code_block_2)  # CPython3
# ---------- 팔린드롬_체크함수_재귀__전역변수_미사용.python (24 lines) ----------
# Load the Python Standard and DesignScript Libraries
import sys
import clr
clr.AddReference('ProtoGeometry')
from Autodesk.DesignScript.Geometry import *

# The inputs to this node will be stored as a list in the IN variables.
dataEnteringNode = IN
ss = IN[0]
# Place your code below this line
def recursion(s, acc):
    if len(s) < 2:
        return 1,acc+1
    elif s[0] == s[-1]:
        acc += 1
        return recursion(s[1:-1], acc)
    else:
        return 0,acc+1

def isPalindrome(s):
    return recursion(s,0)

# Assign your output to the OUT variable.
OUT = map(isPalindrome, ss)
# ----------------------------------------
watch = Watch(팔린드롬_체크함수_재귀__전역변수_미사용)
팔린드롬_체크함수_재귀__전역변수_사용 = Python(IN[0]=code_block_2)  # CPython3
# ---------- 팔린드롬_체크함수_재귀__전역변수_사용.python (32 lines) ----------
# Load the Python Standard and DesignScript Libraries
import sys
import clr
clr.AddReference('ProtoGeometry')
from Autodesk.DesignScript.Geometry import *

# The inputs to this node will be stored as a list in the IN variables.
dataEnteringNode = IN
ss = IN[0]
# Place your code below this line
def recursion(s):
    global cnt
    cnt += 1
    
    if len(s) < 2:
        return 1
    elif s[0] == s[-1]:
        return recursion(s[1:-1])
    else:
        return 0

def isPalindrome(s):
    return recursion(s)

res = []
for s in ss:
    cnt = 0
    res.append([isPalindrome(s),cnt])


# Assign your output to the OUT variable.
OUT = res
# ----------------------------------------
