# Dynamo graph 정수 N개의 합(언어 제한, 함수 구현).dyn (Dynamo 2.13.1.3887)

python_script = Python()  # CPython3; unwired: IN[0]
# ---------- python_script.python (19 lines) ----------
# Load the Python Standard and DesignScript Libraries
import sys
import clr
clr.AddReference('ProtoGeometry')
from Autodesk.DesignScript.Geometry import *

# The inputs to this node will be stored as a list in the IN variables.
dataEnteringNode = IN

# Place your code below this line
a = [1,2,3]

def solve(a: list) -> int:
    return sum(a)
    


# Assign your output to the OUT variable.
OUT = solve(a)
# ----------------------------------------
