# Dynamo graph 좌표 압축.dyn (Dynamo 2.16.1.2727)

code_block = CodeBlock()
# ---------- code_block.designscript (4 lines) ----------
[
5,
"2 4 -10 4 -9"
];
# ----------------------------------------
code_block_2 = CodeBlock { " "; }
code_block_3 = CodeBlock()
# ---------- code_block_3.designscript (4 lines) ----------
[
6,
"1000 999 1000 999 1000 999"
];
# ----------------------------------------
deconstruct = List.Deconstruct(list=code_block_3)
code_block_4 = CodeBlock { " "; }
split = String.Split(string=deconstruct.rest, separator0=code_block_4)
flatten = List.Flatten(list=split)
toNumber = String.ToNumber(string=flatten)
uniqueItems = List.UniqueItems(list=toNumber)
string_from_object = FromObject(object=uniqueItems)
gt = uniqueItems > uniqueItems  # lacing=CrossProduct
countTrue = List.CountTrue(list=gt@L2)
byKeysValues = DesignScript.Builtin.Dictionary.ByKeysValues(keys=string_from_object, values=countTrue)
valueAtKey = DesignScript.Builtin.Dictionary.ValueAtKey(dictionary=byKeysValues, key=flatten)
string_from_object_2 = FromObject(object=valueAtKey)
join = String.Join(separator=code_block_2, string0=string_from_object_2)
watch = Watch(join)
