# Dynamo graph 좌표 정렬하기.dyn (Dynamo 2.16.1.2727)

code_block = CodeBlock { " "; }
code_block_2 = CodeBlock()
# ---------- code_block_2.designscript (8 lines) ----------
[
"5",
"3 4",
"1 1",
"1 -1",
"2 2",
"3 3"
];
# ----------------------------------------
deconstruct = List.Deconstruct(list=code_block_2)
code_block_3 = CodeBlock { " "; }
split = String.Split(string=deconstruct.rest, separator0=code_block_3)
toNumber = String.ToNumber(string=split)
firstItem = List.FirstItem(list=toNumber@L2)
groupByKey = List.GroupByKey(list=toNumber, keys=firstItem)
lastItem = List.LastItem(list=groupByKey.groups@L2)
count = List.Count(list=groupByKey.groups@L2)
chop = List.Chop(list=lastItem, lengths=count)
sortByKey = List.SortByKey(list=groupByKey.groups@L3, keys=chop@L2)
firstItem_2 = List.FirstItem(list=sortByKey.sortedList@L2)
uniqueItems = List.UniqueItems(list=firstItem_2)
sortByKey_2 = List.SortByKey(list=sortByKey.sortedList, keys=uniqueItems)
flatten = List.Flatten(list=sortByKey_2.sortedList@L2)
string_from_object = FromObject(object=flatten)
join = String.Join(separator=code_block, string0=string_from_object)
flatten_2 = List.Flatten(list=join)
watch = Watch(flatten_2)
