# Dynamo graph 직사각형에서 탈출.dyn (Dynamo 2.16.1.2727)

code_block = CodeBlock { "1 1 5 5"; }
code_block_2 = CodeBlock { "6 2 10 3"; }
code_block_3 = CodeBlock { " "; }
split = String.Split(string=code_block_2, separator0=code_block_3)
toNumber = String.ToNumber(string=split)
code_block_4 = CodeBlock { 0..1; 2; }
sublists = List.Sublists(list=toNumber, ranges=code_block_4.out0, offset=code_block_4.out1)
firstItem = List.FirstItem(list=sublists)
code_block_5 = CodeBlock { [0,0]; }
sub = firstItem - code_block_5
lastItem = List.LastItem(list=sublists)
sub_2 = lastItem - firstItem
join = List.Join(list0=sub, list1=sub_2)
minimumItem = List.MinimumItem(list=join)
watch = Watch(minimumItem)
code_block_6 = CodeBlock { "653 375 1000 1000"; }
code_block_7 = CodeBlock { "161 181 762 375"; }
