# Dynamo graph 체스판 다시 칠하기.dyn (Dynamo 2.16.1.2727)

code_block = CodeBlock()
# ---------- code_block.designscript (11 lines) ----------
[
"8 8",
"WBWBWBWB
BWBWBWBW
WBWBWBWB
BWBBBWBW
WBWBWBWB
BWBWBWBW
WBWBWBWB
BWBWBWBW"
];
# ----------------------------------------
code_block_2 = CodeBlock()
# ---------- code_block_2.designscript (13 lines) ----------
[
"10 13",
"BBBBBBBBWBWBW
BBBBBBBBBWBWB
BBBBBBBBWBWBW
BBBBBBBBBWBWB
BBBBBBBBWBWBW
BBBBBBBBBWBWB
BBBBBBBBWBWBW
BBBBBBBBBWBWB
WWWWWWWWWWBWB
WWWWWWWWWWBWB"
];
# ----------------------------------------
code_block_3 = CodeBlock()
# ---------- code_block_3.designscript (11 lines) ----------
[
"8 8",
"BWBWBWBW
WBWBWBWB
BWBWBWBW
WBWBWBWB
BWBWBWBW
WBWBWBWB
BWBWBWBW
WBWBWBWB"
];
# ----------------------------------------
code_block_4 = CodeBlock()
# ---------- code_block_4.designscript (12 lines) ----------
[
"9 23",
"BBBBBBBBBBBBBBBBBBBBBBB
BBBBBBBBBBBBBBBBBBBBBBB
BBBBBBBBBBBBBBBBBBBBBBB
BBBBBBBBBBBBBBBBBBBBBBB
BBBBBBBBBBBBBBBBBBBBBBB
BBBBBBBBBBBBBBBBBBBBBBB
BBBBBBBBBBBBBBBBBBBBBBB
BBBBBBBBBBBBBBBBBBBBBBB
BBBBBBBBBBBBBBBBBBBBBBW"
];
# ----------------------------------------
code_block_5 = CodeBlock()
# ---------- code_block_5.designscript (14 lines) ----------
[
"11 12",
"BWWBWWBWWBWW
BWWBWBBWWBWW
WBWWBWBBWWBW
BWWBWBBWWBWW
WBWWBWBBWWBW
BWWBWBBWWBWW
WBWWBWBBWWBW
BWWBWBWWWBWW
WBWWBWBBWWBW
BWWBWBBWWBWW
WBWWBWBBWWBW"
];
# ----------------------------------------
code_block_6 = CodeBlock(i=code_block_5) { i; }
lastItem = List.LastItem(list=code_block_6)
code_block_7 = CodeBlock { "\n"; }
split = String.Split(string=lastItem, separator0=code_block_7)
firstItem = List.FirstItem(list=code_block_6)
code_block_8 = CodeBlock { " "; }
split_2 = String.Split(string=firstItem, separator0=code_block_8)
toNumber = String.ToNumber(string=split_2)
code_block_9 = CodeBlock(i=toNumber) { i-8; }
range = Range(end=code_block_9)

# group: 행 분리
firstItem_2 = List.FirstItem(list=range)
code_block_10 = CodeBlock { 8; }
add = firstItem_2 + code_block_10
slice = List.Slice(list=split, start=firstItem_2, end=add)

code_block_11 = CodeBlock { 8; }

# group: 열 분리
lastItem_2 = List.LastItem(list=range)
substring = String.Substring(string=slice, startIndex=lastItem_2@L1, length=code_block_11)

concat = String.Concat(string0=substring)
code_block_12 = CodeBlock { "B"; }
startsWith = String.StartsWith(string=concat, searchFor=code_block_12)
code_block_13 = CodeBlock()
# ---------- code_block_13.designscript (10 lines) ----------
[
"WBWBWBWB",
"BWBWBWBW",
"WBWBWBWB",
"BWBWBWBW",
"WBWBWBWB",
"BWBWBWBW",
"WBWBWBWB",
"BWBWBWBW"
];
# ----------------------------------------
concat_2 = String.Concat(string0=code_block_13)
code_block_14 = CodeBlock { ""; }
split_3 = String.Split(string=concat_2, separator0=code_block_14)
code_block_15 = CodeBlock { ""; }
split_4 = String.Split(string=concat, separator0=code_block_15)
count = List.Count(list=split_4@L3)
cycle = List.Cycle(list=split_3@L3, amount=count)
eq = cycle == split_4  # lacing=Shortest
countFalse = List.CountFalse(list=eq@L2)
code_block_16 = CodeBlock()
# ---------- code_block_16.designscript (10 lines) ----------
[
"BWBWBWBW",
"WBWBWBWB",
"BWBWBWBW",
"WBWBWBWB",
"BWBWBWBW",
"WBWBWBWB",
"BWBWBWBW",
"WBWBWBWB"
];
# ----------------------------------------
concat_3 = String.Concat(string0=code_block_16)
code_block_17 = CodeBlock { ""; }
split_5 = String.Split(string=concat_3, separator0=code_block_17)
cycle_2 = List.Cycle(list=split_5@L3, amount=count)
eq_2 = cycle_2 == split_4  # lacing=Shortest
countFalse_2 = List.CountFalse(list=eq_2@L2)
join = List.Join(list0=countFalse, list1=countFalse_2)
minimumItem = List.MinimumItem(list=join)
watch = Watch(minimumItem)
code_block_18 = CodeBlock()
# ---------- code_block_18.designscript (13 lines) ----------
[
"10 10",
"BBBBBBBBBB
BBWBWBWBWB
BWBWBWBWBB
BBWBWBWBWB
BWBWBWBWBB
BBWBWBWBWB
BWBWBWBWBB
BBWBWBWBWB
BWBWBWBWBB
BBBBBBBBBB"
];
# ----------------------------------------
code_block_19 = CodeBlock()
# ---------- code_block_19.designscript (11 lines) ----------
[
"8 8",
"WBWBWBWB
BWBWBWBW
WBWBWBWB
BWBBBWBW
WBWBWBWB
BWBWBWBW
WBWBWWWB
BWBWBWBW"
];
# ----------------------------------------
