# Dynamo graph 최댓값(2차원배열).dyn (Dynamo 2.13.1.3887)

code_block = CodeBlock()
# ---------- code_block.designscript (11 lines) ----------
[
"3 23 85 34 17 74 25 52 65",
"10 7 39 42 88 52 14 72 63",
"87 42 18 78 53 45 18 84 53",
"34 28 64 85 12 16 75 36 55",
"21 77 45 35 28 75 90 76 1",
"25 87 65 15 28 11 37 28 74",
"65 27 75 41 7 89 78 64 39",
"47 47 70 45 23 65 3 41 44",
"87 13 82 38 31 12 29 29 80"
];
# ----------------------------------------
code_block_2 = CodeBlock(i=code_block) { i; }
code_block_3 = CodeBlock { " "; }
split = String.Split(string=code_block_2, separator0=code_block_3)
maximumItem = List.MaximumItem(list=split@L2)
maximumItem_2 = List.MaximumItem(list=maximumItem)
code_block_4 = CodeBlock(max=maximumItem_2) { max; }
code_block_5 = CodeBlock { " "; }
code_block_6 = CodeBlock { 1; }
contains = List.Contains(list=split@L2, item=maximumItem_2)
code_block_7 = CodeBlock { true; }
indexOf = List.IndexOf(list=contains, element=code_block_7)
getItemAtIndex = List.GetItemAtIndex(list=split, index=indexOf)
contains_2 = List.Contains(list=getItemAtIndex@L1, item=maximumItem_2)
code_block_8 = CodeBlock { true; }
indexOf_2 = List.IndexOf(list=contains_2, element=code_block_8)
join = List.Join(list0=indexOf, list1=indexOf_2)
add = code_block_6 + join
string_from_object = FromObject(object=add)
join_2 = String.Join(separator=code_block_5, string0=string_from_object)
join_3 = List.Join(list0=code_block_4, list1=join_2)
watch = Watch(join_3)
