# Dynamo graph 최댓값.dyn (Dynamo 2.13.1.3887)

code_block = CodeBlock { 3; 29; 38; 12; 57; 74; 40; 85; 61; }
join = List.Join(list0=code_block.out0, list1=code_block.out1, list2=code_block.out2, list3=code_block.out3, list4=code_block.out4, list5=code_block.out5, list6=code_block.out6, list7=code_block.out7, list8=code_block.out8)
maximumItem = List.MaximumItem(list=join)
firstItem = List.FirstItem(list=maximumItem)
code_block_2 = CodeBlock(i=firstItem) { i: int; }
indexOf = List.IndexOf(list=join, element=code_block_2)
code_block_3 = CodeBlock(i=indexOf) { i+1; }
join_2 = List.Join(list0=code_block_2, list1=code_block_3)
watch = Watch(join_2)
