# Dynamo graph 최소공배수.dyn (Dynamo 2.16.1.2727)

code_block = CodeBlock()
# ---------- code_block.designscript (4 lines) ----------
"3
1 45000
6 10
13 17";
# ----------------------------------------
code_block_2 = CodeBlock { "\n"; }
split = String.Split(string=code_block, separator0=code_block_2)
code_block_3 = CodeBlock { " "; }
split_2 = String.Split(string=split, separator0=code_block_3)
toNumber = String.ToNumber(string=split_2)
deconstruct = List.Deconstruct(list=toNumber)
firstItem = List.FirstItem(list=deconstruct.rest@L2)
lastItem = List.LastItem(list=deconstruct.rest@L2)
mul = firstItem * lastItem
getGCD = Python(IN[0]=deconstruct.rest)  # CPython3
# ---------- getGCD.python (22 lines) ----------
# Load the Python Standard and DesignScript Libraries
import sys
import clr
clr.AddReference('ProtoGeometry')
from Autodesk.DesignScript.Geometry import *

# The inputs to this node will be stored as a list in the IN variables.
dataEnteringNode = IN
pairs = IN[0]
# Place your code below this line

def getGCD(pair):
    a = max(pair)
    b = min(pair)
    if a % b == 0:
        return b
    elif b == 0:
        return a
    else:
        return getGCD([a%b, b])
# Assign your output to the OUT variable.
OUT = map(getGCD, pairs)
# ----------------------------------------
div = mul / getGCD
watch = Watch(div)
