# Dynamo graph 커트라인.dyn (Dynamo 2.16.1.2727)

code_block = CodeBlock { "5 2"; "100 76 85 93 98"; }
join = List.Join(list0=code_block.out0, list1=code_block.out1)
code_block_2 = CodeBlock { " "; }
split = String.Split(string=join, separator0=code_block_2)
toNumber = String.ToNumber(string=split)
deconstruct = List.Deconstruct(list=toNumber)
firstItem = List.FirstItem(list=deconstruct.rest)
code_block_3 = CodeBlock { 0; }
sub = code_block_3 - _  # unwired: y
sortByFunction = List.SortByFunction(list=firstItem, sortFunction=sub)
lastItem = List.LastItem(list=deconstruct.first)
takeItems = List.TakeItems(list=sortByFunction, amount=lastItem)
lastItem_2 = List.LastItem(list=takeItems)
watch = Watch(lastItem_2)
