# Dynamo graph 큰 수 A+B.dyn (Dynamo 2.13.1.3887)

# note: obj 생성해서 다시 짜보기

code_block = CodeBlock { 1; }
code_block_2 = CodeBlock { "9223372036854775807 9223372036854775808"; }
code_block_3 = CodeBlock { " "; }
split = String.Split(string=code_block_2, separator0=code_block_3)
code_block_4 = CodeBlock { ""; }
split_2 = String.Split(string=split, separator0=code_block_4)
toNumber = String.ToNumber(string=split_2)
transpose = List.Transpose(lists=toNumber)
sum = Math.Sum(values=transpose@L2)
reverse = List.Reverse(list=sum)
string_from_object = FromObject(object=reverse)
code_block_5 = CodeBlock { "."; }
split_3 = String.Split(string=string_from_object, separator0=code_block_5)
deconstruct = List.Deconstruct(list=split_3@L2)
code_block_6 = CodeBlock { ""; }
split_4 = String.Split(string=deconstruct.first, separator0=code_block_6)
count = List.Count(list=split_4)
code_block_7 = CodeBlock(i=count) { i; }
range = Range(start=code_block, end=code_block_7)
count_2 = List.Count(list=split_4@L2)
code_block_8 = CodeBlock(i=count_2) { i == 1 ? true:false; }
code_block_9 = CodeBlock { true; }
allIndicesOf = List.AllIndicesOf(list=code_block_8, item=code_block_9)
code_block_10 = CodeBlock { false; }
allIndicesOf_2 = List.AllIndicesOf(list=code_block_8, item=code_block_10)
getItemAtIndex = List.GetItemAtIndex(list=split_4, index=allIndicesOf_2)
deconstruct_2 = List.Deconstruct(list=getItemAtIndex@L2)
code_block_11 = CodeBlock { 1; }
add = code_block_11 + allIndicesOf_2
getItemAtIndex_2 = List.GetItemAtIndex(list=split_4, index=add)
code_block_12 = CodeBlock { 1; }
count_3 = List.Count(list=split_4)
sequence = Sequence(start=code_block_12, amount=count_3)
string_from_object_2 = FromObject(object=sequence)
code_block_13 = CodeBlock {  }
count_4 = List.Count(list=transpose)
code_block_14 = CodeBlock(i=count_4) { 1..i+1; }
string_from_object_3 = FromObject(object=code_block_14)
byKeysValues = DesignScript.Builtin.Dictionary.ByKeysValues(keys=string_from_object_3, values=split_4)
keys = DesignScript.Builtin.Dictionary.Keys(dictionary=byKeysValues)
toNumber_2 = String.ToNumber(string=keys)
code_block_15 = CodeBlock { 1; }
add_2 = toNumber_2 + code_block_15
string_from_object_4 = FromObject(object=add_2)
lastItem = List.LastItem(list=string_from_object_3)
code_block_16 = CodeBlock { [[]]; }
setValueAtKeys = DesignScript.Builtin.Dictionary.SetValueAtKeys(dictionary=byKeysValues, keys=lastItem, values=code_block_16)
valueAtKey = DesignScript.Builtin.Dictionary.ValueAtKey(dictionary=setValueAtKeys, key=keys)
filterByBoolMask = List.FilterByBoolMask(list=setValueAtKeys)  # unwired: mask
code_block_17 = CodeBlock { i[]; }  # unwired: i
