# Dynamo graph 킹, 퀸, 룩, 비숍, 나이트, 폰.dyn (Dynamo 2.13.1.3887)

code_block = CodeBlock { 0; 1; 2; 2; 2; 7; }
code_block_2 = CodeBlock(k=code_block.out0, q=code_block.out1, r=code_block.out2, b=code_block.out3, n=code_block.out4, p=code_block.out5)
# ---------- code_block_2.designscript (8 lines) ----------
{
"king": k,
"queen": q,
"rook": r,
"bishop": b,
"knight": n,
"pawn": p
};
# ----------------------------------------
code_block_3 = CodeBlock { 1; 1; 2; 2; 2; 8; }
code_block_4 = CodeBlock(k=code_block_3.out0, q=code_block_3.out1, r=code_block_3.out2, b=code_block_3.out3, n=code_block_3.out4, p=code_block_3.out5)  # same code as code_block_2
components = DesignScript.Builtin.Dictionary.Components(dictionary=code_block_4)
code_block_5 = CodeBlock { 2; 1; 2; 1; 2; 1; }
code_block_6 = CodeBlock(k=code_block_5.out0, q=code_block_5.out1, r=code_block_5.out2, b=code_block_5.out3, n=code_block_5.out4, p=code_block_5.out5)  # same code as code_block_2
valueAtKey = DesignScript.Builtin.Dictionary.ValueAtKey(dictionary=code_block_6, key=components.keys)
sub = components.values - valueAtKey
byKeysValues = DesignScript.Builtin.Dictionary.ByKeysValues(keys=components.keys, values=sub)
code_block_7 = CodeBlock()
# ---------- code_block_7.designscript (8 lines) ----------
[
"king",
"queen",
"rook",
"bishop",
"knight",
"pawn"
];
# ----------------------------------------
valueAtKey_2 = DesignScript.Builtin.Dictionary.ValueAtKey(dictionary=byKeysValues, key=code_block_7)
watch = Watch(valueAtKey_2)
