# Dynamo graph 통계학.dyn (Dynamo 2.16.1.2727)

code_block = CodeBlock()
# ---------- code_block.designscript (8 lines) ----------
[
5,
1,
3,
8,
-2,
2
];
# ----------------------------------------
code_block_2 = CodeBlock()
# ---------- code_block_2.designscript (6 lines) ----------
[
3,
0,
0,
-1
];
# ----------------------------------------
deconstruct = List.Deconstruct(list=code_block_2)
average = Math.Average(numbers=deconstruct.rest)
code_block_3 = CodeBlock { 0; }
round = Math.Round(number=average, digits=code_block_3)
sort = List.Sort(list=deconstruct.rest)
count = List.Count(list=sort)
code_block_4 = CodeBlock { 2; }
div = count / code_block_4
floor = Math.Floor(number=div)
getItemAtIndex = List.GetItemAtIndex(list=sort, index=floor)
groupByKey = List.GroupByKey(list=sort, keys=sort)
count_2 = List.Count(list=groupByKey.groups@L2)
maximumItem = List.MaximumItem(list=count_2)
code_block_5 = CodeBlock(i=count_2, j=maximumItem) { i==j; }
filterByBoolMask = List.FilterByBoolMask(list=groupByKey.groups, mask=code_block_5)
flatten = List.Flatten(list=filterByBoolMask.in)
sort_2 = List.Sort(list=flatten)
groupByKey_2 = List.GroupByKey(list=sort_2, keys=sort_2)
code_block_6 = CodeBlock { 1; }
count_3 = List.Count(list=groupByKey_2.uniqueKeys)
eq = code_block_6 == count_3
code_block_7 = CodeBlock { 0; 1; }
if_ = RefactoredIf(test=eq, true=code_block_7.out0, false=code_block_7.out1)
getItemAtIndex_2 = List.GetItemAtIndex(list=groupByKey_2.uniqueKeys, index=if_)
code_block_8 = CodeBlock(i=sort) { i; }
lastItem = List.LastItem(list=code_block_8)
firstItem = List.FirstItem(list=code_block_8)
sub = lastItem - firstItem
join = List.Join(list0=round, list1=getItemAtIndex, list2=getItemAtIndex_2, list3=sub)
watch = Watch(join)
code_block_9 = CodeBlock()
# ---------- code_block_9.designscript (4 lines) ----------
[
1,
4000
];
# ----------------------------------------
code_block_10 = CodeBlock()
# ---------- code_block_10.designscript (8 lines) ----------
[
5,
-1,
-2,
-3,
-1,
-2
];
# ----------------------------------------
