# Dynamo graph 팩토리얼.dyn (Dynamo 2.16.1.2727)

code_block = CodeBlock { 0; }
code_block_2 = CodeBlock { 10; }
python_script = Python(IN[0]=code_block_2)  # CPython3; frozen
# ---------- python_script.python (21 lines) ----------
# Load the Python Standard and DesignScript Libraries
import sys
import clr
clr.AddReference('ProtoGeometry')
from Autodesk.DesignScript.Geometry import *

# The inputs to this node will be stored as a list in the IN variables.
dataEnteringNode = IN
n = IN[0]

# Place your code below this line

def factorial(n):
    if n == 0:
        return 1
    elif n == 1:
        return 1
    return n * factorial(n-1)

# Assign your output to the OUT variable.
OUT = factorial(n)
# ----------------------------------------
fibonacci = Custom[fibonacci]()  # fibonacci_recursion; unwired: Start, Next, ListLength
