# Dynamo graph 평균.dyn (Dynamo 2.13.1.3887)

code_block = CodeBlock { 3; "40 80 60"; }
join = List.Join(list0=code_block.out0, list1=code_block.out1)
code_block_2 = CodeBlock { 9; "10 20 30 40 50 60 70 80 90"; }
join_2 = List.Join(list0=code_block_2.out0, list1=code_block_2.out1)
deconstruct = List.Deconstruct(list=join_2)
deconstruct_2 = List.Deconstruct(list=deconstruct.rest)
code_block_3 = CodeBlock { " "; }
split = String.Split(string=deconstruct_2.first, separator0=code_block_3)
toNumber = String.ToNumber(string=split)
maximumItem = List.MaximumItem(list=toNumber)
code_block_4 = CodeBlock(score=toNumber, M=maximumItem) { score / M * 100; }
average = Math.Average(numbers=code_block_4)
code_block_5 = CodeBlock(i=average) { i: double; }
watch = Watch(code_block_5)
code_block_6 = CodeBlock { 3; "10 20 30"; }
join_3 = List.Join(list0=code_block_6.out0, list1=code_block_6.out1)
code_block_7 = CodeBlock { 4; "1 100 100 100"; }
join_4 = List.Join(list0=code_block_7.out0, list1=code_block_7.out1)
code_block_8 = CodeBlock { 5; "1 2 4 8 16"; }
join_5 = List.Join(list0=code_block_8.out0, list1=code_block_8.out1)
code_block_9 = CodeBlock { 2; "3 10"; }
join_6 = List.Join(list0=code_block_9.out0, list1=code_block_9.out1)
code_block_10 = CodeBlock { 4; "10 20 0 100"; }
join_7 = List.Join(list0=code_block_10.out0, list1=code_block_10.out1)
code_block_11 = CodeBlock { 1; "50"; }
join_8 = List.Join(list0=code_block_11.out0, list1=code_block_11.out1)
