# Dynamo graph 평균은 넘겠지.dyn (Dynamo 2.13.1.3887)

code_block = CodeBlock { ""; }
list_create = List.Create()  # unwired: item0, item1
code_block_2 = CodeBlock()
# ---------- code_block_2.designscript (8 lines) ----------
[
5,
"5 50 50 70 80 100",
"7 100 95 90 80 70 60 50",
"3 70 90 80",
"3 70 90 81",
"9 100 99 98 97 96 95 94 93 91"
];
# ----------------------------------------
deconstruct = List.Deconstruct(list=code_block_2)
code_block_3 = CodeBlock { " "; }
split = String.Split(string=deconstruct.rest, separator0=code_block_3)
toNumber = String.ToNumber(string=split)
deconstruct_2 = List.Deconstruct(list=toNumber@L2)
average = Math.Average(numbers=deconstruct_2.rest)
gt = deconstruct_2.rest > average  # lacing=Shortest
filterByBoolMask = List.FilterByBoolMask(list=deconstruct_2.rest, mask=gt, lacing=Shortest)
count = List.Count(list=filterByBoolMask.in@L2)
code_block_4 = CodeBlock(studentsNum=deconstruct_2.first) { studentsNum; }
div = count / code_block_4  # lacing=Shortest
code_block_5 = CodeBlock { 100; }
mul = div * code_block_5
code_block_6 = CodeBlock { 3; }
round = Math.Round(number=mul, digits=code_block_6)
string_from_object = FromObject(object=round)
code_block_7 = CodeBlock { -1; -3; }
remove = String.Remove(string=string_from_object, startIndex=code_block_7.out0, count=code_block_7.out1)
code_block_8 = CodeBlock { "%"; }
count_2 = List.Count(list=remove)
ofRepeatedItem = List.OfRepeatedItem(item=code_block_8, amount=count_2)
combine = List.Combine(combineFunction=list_create, list0=remove, list1=ofRepeatedItem)
join = String.Join(separator=code_block, string0=combine)
flatten = List.Flatten(list=join)
watch = Watch(flatten)
