# Dynamo graph 피보나치 수 5.dyn (Dynamo 2.16.1.2727)

code_block = CodeBlock { 10; }
python_script = Python(IN[0]=code_block)  # CPython3
# ---------- python_script.python (20 lines) ----------
# Load the Python Standard and DesignScript Libraries
import sys
import clr
clr.AddReference('ProtoGeometry')
from Autodesk.DesignScript.Geometry import *

# The inputs to this node will be stored as a list in the IN variables.
dataEnteringNode = IN
n = IN[0]
# Place your code below this line

def fibo(n):
    if n > 1:
        return fibo(n-1) + fibo(n-2)
    else:
        return n


# Assign your output to the OUT variable.
OUT = fibo(n)
# ----------------------------------------
watch = Watch(python_script)
