# Dynamo graph 한수.dyn (Dynamo 2.13.1.3887)

code_block = CodeBlock { 110; }
code_block_2 = CodeBlock { 1; }
code_block_3 = CodeBlock { 500; }
code_block_4 = CodeBlock(i=code_block_3) { i; }
range = Range(start=code_block_2, end=code_block_4)
code_block_5 = CodeBlock { 100; }
lt = range < code_block_5
filterByBoolMask = List.FilterByBoolMask(list=range, mask=lt)
count = List.Count(list=filterByBoolMask.in)
string_from_object = FromObject(object=filterByBoolMask.out)
code_block_6 = CodeBlock { ""; }
split = String.Split(string=string_from_object, separator0=code_block_6)
toNumber = String.ToNumber(string=split)
code_block_7 = CodeBlock(i=toNumber) { i; }
isEmpty = List.IsEmpty(list=code_block_7)
code_block_8 = CodeBlock { 0..999; }
if_ = RefactoredIf(test=isEmpty, true=code_block_8, false=code_block_7)
code_block_9 = CodeBlock { 2; }
getItemAtIndex = List.GetItemAtIndex(list=if_@L2, index=code_block_9)
code_block_10 = CodeBlock(i=toNumber) { i; }
isEmpty_2 = List.IsEmpty(list=code_block_10)
code_block_11 = CodeBlock { 0..999..2; }
if_2 = RefactoredIf(test=isEmpty_2, true=code_block_11, false=code_block_10)
code_block_12 = CodeBlock { 1; }
getItemAtIndex_2 = List.GetItemAtIndex(list=if_2@L2, index=code_block_12)
sub = getItemAtIndex - getItemAtIndex_2
code_block_13 = CodeBlock(i=toNumber) { i; }
isEmpty_3 = List.IsEmpty(list=code_block_13)
code_block_14 = CodeBlock { 0..999..3; }
if_3 = RefactoredIf(test=isEmpty_3, true=code_block_14, false=code_block_13)
code_block_15 = CodeBlock { 0; }
getItemAtIndex_3 = List.GetItemAtIndex(list=if_3@L2, index=code_block_15)
sub_2 = getItemAtIndex_2 - getItemAtIndex_3
eq = sub == sub_2
filterByBoolMask_2 = List.FilterByBoolMask(list=split, mask=eq)
toNumber_2 = String.ToNumber(string=filterByBoolMask_2.in)
isEmpty_4 = List.IsEmpty(list=toNumber_2)
code_block_16 = CodeBlock { 0; }
concat = String.Concat(string0=filterByBoolMask_2.in)
count_2 = List.Count(list=concat@L2)
if_4 = RefactoredIf(test=isEmpty_4, true=code_block_16, false=count_2)
firstItem = List.FirstItem(list=if_4)
code_block_17 = CodeBlock(a=count, b=firstItem) { a+b; }
watch = Watch(code_block_17)
code_block_18 = CodeBlock { 1; }
code_block_19 = CodeBlock { 210; }
code_block_20 = CodeBlock { 1000; }
