# Dynamo graph 합.dyn (Dynamo 2.13.1.3887)

add = _ + _  # unwired: x, y
code_block = CodeBlock { 0; }
code_block_2 = CodeBlock { 1; }
code_block_3 = CodeBlock { 3; }
range = Range(start=code_block_2, end=code_block_3)
reduce = List.Reduce(reduceFunction=add, seed=code_block, list0=range)
watch = Watch(reduce)
