# Dynamo graph 행렬 덧셈.dyn (Dynamo 2.13.1.3887)

code_block = CodeBlock { " "; }
code_block_2 = CodeBlock()
# ---------- code_block_2.designscript (9 lines) ----------
[
"3 3",
"1 1 1",
"2 2 2",
"0 1 0",
"3 3 3",
"4 4 4",
"5 5 100"
];
# ----------------------------------------
code_block_3 = CodeBlock { " "; }
split = String.Split(string=code_block_2, separator0=code_block_3)
toNumber = String.ToNumber(string=split)
deconstruct = List.Deconstruct(list=toNumber)
code_block_4 = CodeBlock(i=deconstruct.rest) { i; }
# note: 행의 개수
# 열의 개수
code_block_5 = CodeBlock(i=deconstruct.first) { i; }
# note: 행의 개수
firstItem = List.FirstItem(list=code_block_5)
code_block_6 = CodeBlock(i=firstItem) { 0..i-1; }
sublists = List.Sublists(list=code_block_4, ranges=code_block_6, offset=firstItem)
firstItem_2 = List.FirstItem(list=sublists)
lastItem = List.LastItem(list=sublists)
add = firstItem_2 + lastItem
string_from_object = FromObject(object=add)
join = String.Join(separator=code_block, string0=string_from_object@L2)
watch = Watch(join)
