# Dynamo graph Earth_CT.dyn (Dynamo 2.16.1.2727)

select_model_element = DSModelElementSelection()  # 1 picked in the model
geometry = Element.Geometry(element=select_model_element)
vertexPositions = Mesh.VertexPositions(mesh=geometry)
code_block = CodeBlock(i=vertexPositions) { i[0]; }
python_script = Python(IN[0]=code_block)  # CPython3; frozen
# ---------- python_script.python (154 lines) ----------
import clr
import math
clr.AddReference('RevitServices')
from RevitServices.Persistence import DocumentManager
from RevitServices.Transactions import TransactionManager

clr.AddReference('RevitAPI')
from Autodesk.Revit.DB import *

# Autodesk DesignScript Geometry (Dynamo Geometry) import
clr.AddReference("ProtoGeometry")
from Autodesk.DesignScript.Geometry import *

# --------------------------------------------------------------------
# Helper 함수: box_min, box_max, transform을 이용해 DS cuboid(솔리드)를 생성
# --------------------------------------------------------------------
def createCuboid(box_min, box_max, transform):
    # 1. 로컬 코너들 계산 (Bounding Box의 8개 코너)
    corners = []
    corners.append(XYZ(box_min.X, box_min.Y, box_min.Z))
    corners.append(XYZ(box_max.X, box_min.Y, box_min.Z))
    corners.append(XYZ(box_max.X, box_max.Y, box_min.Z))
    corners.append(XYZ(box_min.X, box_max.Y, box_min.Z))
    corners.append(XYZ(box_min.X, box_min.Y, box_max.Z))
    corners.append(XYZ(box_max.X, box_min.Y, box_max.Z))
    corners.append(XYZ(box_max.X, box_max.Y, box_max.Z))
    corners.append(XYZ(box_min.X, box_max.Y, box_max.Z))
    
    # 2. 로컬 코너들에 transform 적용하여 글로벌 좌표의 코너 계산
    globalCorners = [transform.OfPoint(pt) for pt in corners]
    
    # 3. Revit API의 XYZ를 DS 포인트로 변환
    dsPoints = [Point.ByCoordinates(pt.X, pt.Y, pt.Z) for pt in globalCorners]
    
    # 4. 각 면을 PolyCurve와 Surface.ByPatch로 생성
    # (면의 순서는 시계/반시계 순서로 정의)
    bottomCurve = PolyCurve.ByPoints([dsPoints[0], dsPoints[1], dsPoints[2], dsPoints[3]], True)
    bottomSurface = Surface.ByPatch(bottomCurve)
    
    topCurve = PolyCurve.ByPoints([dsPoints[4], dsPoints[5], dsPoints[6], dsPoints[7]], True)
    topSurface = Surface.ByPatch(topCurve)
    
    frontCurve = PolyCurve.ByPoints([dsPoints[0], dsPoints[1], dsPoints[5], dsPoints[4]], True)
    frontSurface = Surface.ByPatch(frontCurve)
    
    backCurve = PolyCurve.ByPoints([dsPoints[3], dsPoints[2], dsPoints[6], dsPoints[7]], True)
    backSurface = Surface.ByPatch(backCurve)
    
    leftCurve = PolyCurve.ByPoints([dsPoints[0], dsPoints[3], dsPoints[7], dsPoints[4]], True)
    leftSurface = Surface.ByPatch(leftCurve)
    
    rightCurve = PolyCurve.ByPoints([dsPoints[1], dsPoints[2], dsPoints[6], dsPoints[5]], True)
    rightSurface = Surface.ByPatch(rightCurve)
    
    # 5. 면들을 합쳐 솔리드( cuboid ) 생성
    solid = Solid.ByJoinedSurfaces([bottomSurface, topSurface, frontSurface, backSurface, leftSurface, rightSurface])
    return solid

# --------------------------------------------------------------------
# 1. VertexPositions 입력받기 (IN[0]는 Autodesk.Revit.DB.XYZ 객체 리스트)
# --------------------------------------------------------------------
vertexPositions = IN[0]
if not vertexPositions or len(vertexPositions) == 0:
    raise Exception("VertexPositions 입력이 비어 있습니다.")

# 전체 형상의 Bounding Box 계산
min_x = min(pt.X for pt in vertexPositions)
max_x = max(pt.X for pt in vertexPositions)
min_y = min(pt.Y for pt in vertexPositions)
max_y = max(pt.Y for pt in vertexPositions)
min_z = min(pt.Z for pt in vertexPositions)
max_z = max(pt.Z for pt in vertexPositions)

min_pt = XYZ(min_x, min_y, min_z)
max_pt = XYZ(max_x, max_y, max_z)

# --------------------------------------------------------------------
# 2. 섹션 배치 파라미터 설정
# --------------------------------------------------------------------
spacing = 5000.0       # 단면 간격 (mm)
section_depth = 3000.0  # 섹션박스의 폭 (mm)
section_height = 5000.0 # 섹션박스의 높이 (mm)

# 장축(긴 방향) 판별: X축과 Y축 길이 비교
length_x = abs(max_pt.X - min_pt.X)
length_y = abs(max_pt.Y - min_pt.Y)

if length_x >= length_y:
    axis = "X"
    start = min_pt.X
    end = max_pt.X
    fixed_value = (min_pt.Y + max_pt.Y) / 2.0
else:
    axis = "Y"
    start = min_pt.Y
    end = max_pt.Y
    fixed_value = (min_pt.X + max_pt.X) / 2.0

total_length = end - start
num_sections = int(total_length / spacing)

# --------------------------------------------------------------------
# 3. 섹션뷰 생성 및 해당 섹션박스와 동일한 cuboid 생성
# --------------------------------------------------------------------
doc = DocumentManager.Instance.CurrentDBDocument
TransactionManager.Instance.EnsureInTransaction(doc)

sections = []          # 생성된 섹션뷰 리스트
section_locations = [] # 섹션뷰 중심 좌표 기록
cuboids = []           # DS Solid( cuboid ) 리스트

for i in range(num_sections + 1):
    if axis == "X":
        x_coord = start + i * spacing
        section_origin = XYZ(x_coord, fixed_value, (min_pt.Z + max_pt.Z)/2.0)
    else:
        y_coord = start + i * spacing
        section_origin = XYZ(fixed_value, y_coord, (min_pt.Z + max_pt.Z)/2.0)
    
    # 섹션박스의 로컬 좌표계에서의 최소/최대 점 계산
    box_min = XYZ(section_origin.X - section_depth/2.0,
                  section_origin.Y - section_depth/2.0,
                  section_origin.Z - section_height/2.0)
    box_max = XYZ(section_origin.X + section_depth/2.0,
                  section_origin.Y + section_depth/2.0,
                  section_origin.Z + section_height/2.0)
    
    # 섹션박스에 적용할 회전 변환: 여기서는 Y축 기준으로 90° 회전하여 단면(측면) 뷰로 전환
    sideTransform = Transform.CreateRotationAtPoint(XYZ.BasisY, math.radians(90), section_origin)
    
    # BoundingBoxXYZ 생성 및 변환 적용
    section_box = BoundingBoxXYZ()
    section_box.Min = box_min
    section_box.Max = box_max
    section_box.Transform = sideTransform

    # 섹션뷰 생성
    section = ViewSection.CreateSection(doc, doc.GetDefaultElementTypeId(ElementTypeGroup.ViewTypeSection), section_box)
    section.Name = "Earth Section_{0}".format(i+1)
    section.CropBoxActive = True
    
    sections.append(section)
    section_locations.append((section_origin.X, section_origin.Y, section_origin.Z))
    
    # 위의 box_min, box_max, sideTransform을 이용해 DS cuboid 생성
    dsCuboid = createCuboid(box_min, box_max, sideTransform)
    cuboids.append(dsCuboid)

TransactionManager.Instance.TransactionTaskDone()

# --------------------------------------------------------------------
# 4. 결과 출력: 섹션뷰, 섹션 중심 좌표, 그리고 생성된 cuboid(솔리드) 리스트
# --------------------------------------------------------------------
OUT = (sections, section_locations, cuboids)
# ----------------------------------------
startPoint = Curve.StartPoint()  # unwired: curve
splitByParameter = Curve.SplitByParameter()  # unwired: curve, parameters
pointAtParameter = Curve.PointAtParameter()  # unwired: curve
