# Dynamo graph [H_PAB.RT.B0]_Revit Finish Style 주입기_[3.0.2].dyn (Dynamo 2.16.1.2727)
# author: MK Jang
# Inject Finish Style Data in Building List into Revit Key Schedule

# note: 시트중 최 상위 Row Idx를  행의 첫번째 값 문자열이 ':'를 포함하는 지 검사하는 것으로 로직 대체

# group: Filtering Finish Style Schedule
categories = Categories("OST_Schedules")
all_elements_of_category = ElementsOfCategory(Category=categories)
name = Element.Name(element=all_elements_of_category)
isfinishstyleschedule = Python(IN[0]=name)  # CPython3
# ---------- isfinishstyleschedule.python (49 lines) ----------
# Load the Python Standard and DesignScript Libraries
import sys
import clr
clr.AddReference('ProtoGeometry')
from Autodesk.DesignScript.Geometry import *

# The inputs to this node will be stored as a list in the IN variables.
dataEnteringNode = IN
sch_names_list = IN[0]
# Place your code below this line
tgtList = [
#    "Floor Finish Style",
#    "Base Finish Style",
#    "Wall Finish Style",
#    "Ceiling Finish Style",
    "(Floor)",
    "(Skirt)",
    "(Wall)",
    "(Ceiling)",
    "Wall Style",
    "Roof Style",
    "Door Style",
    "Window Style",
    ]
#tgtStr = "Key Schedule"

def isInStr_tgt(inStr,tgtStr):
    if tgtStr in inStr:
        res = True
    else:
        res = False
    return res

def isInStr_tgtList(inStr,tgtList):
    tmp = []
    for tgt in tgtList:
        if tgt in inStr:
            tmp.append(True)
        else:
            tmp.append(False)
    return any(tmp)
        

#res = list(map(lambda x: isInStr_tgt(x, tgtStr) , sch_names_list))
res = list(map(lambda x: isInStr_tgtList(x, tgtList) , sch_names_list))    


# Assign your output to the OUT variable.
OUT = res
# ----------------------------------------
filterByBoolMask = List.FilterByBoolMask(list=all_elements_of_category, mask=isfinishstyleschedule)

code_block = CodeBlock(i=all_elements_of_category) { i[41]; }
code_block_2 = CodeBlock { "1. 건축평면도"; }

# group: Import From Excel
n0_엑셀_경로 = Filename("..\..\..\OneDrive - 현대엔지니어링(주)\mkSpace\_000_HEC\2024\2024 기술과제계획서\1_BIM\결과보고\r5 키스케줄\(첨부 1)Detail Design Check Sheet_MK.xls")  # "0. 엑셀 경로"; graph input
file_from_path = FileObject(path=n0_엑셀_경로)
boolean = BoolSelector(true)
importExcel = Data.ImportExcel(file=file_from_path, sheetName=code_block_2, showExcel=boolean)

code_block_3 = CodeBlock(i=importExcel) { i; }
code_block_4 = CodeBlock(sheet=code_block_2) { sheet; }
n2_end_of_col = StringInput("M")  # "2. End of Col"; graph input
유효데이터_경계_col_idx_추출 = Python(IN[0]=n2_end_of_col)  # CPython3
# ---------- 유효데이터_경계_col_idx_추출.python (15 lines) ----------
# Load the Python Standard and DesignScript Libraries
import sys
import clr
clr.AddReference('ProtoGeometry')
from Autodesk.DesignScript.Geometry import *

# The inputs to this node will be stored as a list in the IN variables.
dataEnteringNode = IN
inputChar = IN[0]
# Place your code below this line

resInt = ord(inputChar)-64

# Assign your output to the OUT variable.
OUT = resInt
# ----------------------------------------
parse_시트_as_dict__only_int_debug = Python(IN[0]=code_block_3, IN[1]=code_block_4, IN[2]=유효데이터_경계_col_idx_추출)  # CPython3
# ---------- parse_시트_as_dict__only_int_debug.python (140 lines) ----------
# Load the Python Standard and DesignScript Libraries
import sys
import clr
clr.AddReference('ProtoGeometry')
from Autodesk.DesignScript.Geometry import *

from functools import partial
from itertools import chain

import re

#################################Module For Functional Programing#############################################
from functools import reduce
curry = lambda f: lambda a,*args: f(a, *args) if (len(args)) else lambda *args: f(a, *args)

filter = curry(filter)
map = curry(map)

def _take(length, iter):
    res = []
    for a in iter:
        res.append(a)
        if len(res) == length:
            return res
        
take = curry(_take)
reduce = curry(reduce)

go = lambda *args: reduce(lambda a,f: f(a), args) ## 함수도 축약 가능 ##
##############################################################################################################

# The inputs to this node will be stored as a list in the IN variables.
dataEnteringNode = IN
sheetName = IN[1]
sheetDatas = IN[0]
ignoreHdr_idxDic = IN[2] + 1

# Place your code below this line

def find_IsInStr(target, str):
    if target == None or str == None:
        pass
    else:
        res = target in str
        return res

def find_IsIn_list(target, lst):
    if target == None or str == None:
        pass
    else:
        res = target in lst
        return res

def find_range_by_columnItem(db, col_idx, sep_rule):
    tdb = list(map(lambda x: x[col_idx], db))
    last_idx_tdb = len(tdb)-1
    tdb_enum = enumerate(tdb)
    res = list(filter(lambda x: find_IsInStr(sep_rule, x[1]), tdb_enum))
    endidxs_tmp= list(map(lambda x: x[0]-1,res))
    endidxs_tmp.pop(0)
    endidxs = endidxs_tmp + [last_idx_tdb]

    DB_prime_Areas_Names = list(map(lambda x: x[1],res))
    DB_prime_Areas_Names_Idxs = list(map(lambda x: x[0],res))
    rangeSttIdxs = list(map(lambda x: x[0]+1,res))
    rangeEndIdxs = endidxs
    result = dict(zip(DB_prime_Areas_Names, zip(DB_prime_Areas_Names_Idxs, zip(rangeSttIdxs,rangeEndIdxs))))
    return result

def modify_DB_prime_Areas_Names(AIOdict, rule_Char):
    res = list(map(lambda x: x, AIOdict.items()))
    keys = list(map(lambda x: x[0].split(rule_Char)[0], res))
    vals = list(map(lambda x: x[1], res))
    return dict(zip(keys, vals))
    
    
def find_headersAtSheet(sheet):
    headers_sheet = map(lambda x: [x[1].replace("\n",""),x[0]], filter(lambda x: x[1] != None, enumerate(sheet[1])))
    
    return dict(headers_sheet)

def find_rangesAtSheet(sheet, hdrs_withIdx, trgt_hdr, trgt_str):
    return find_range_by_columnItem(sheet, hdrs_withIdx[trgt_hdr], trgt_str)

def find_rangesAtSheet_eq(sheet, hdrs_withIdx, trgt_hdr, row_sep_criteria):
    res = find_range_by_columnItem_Eq(sheet, hdrs_withIdx[trgt_hdr], row_sep_criteria)
    
    return res

def get_areaHeaders(areasDB, ignoreHdr_idxDic):
    #res = list(filter(lambda x: '#' in x[1], areasDB))
    res = []
    for idx,v in enumerate(areasDB):
        if '#' in  str(v[1]):
            res.append([idx,v])
            #res = [idx,v]
    firstHdr = res#[0]#[:ignoreHdr_idxDic]
    return firstHdr
    
def get_sheetHeaders(sheetName, sheetDatas, ignoreHdr_idxDic):
    res = []
    for idx,v in enumerate(sheetDatas):
        #if '#' in  str(v[1]):
        if '#' in  str(v):
            res.append([idx,v])
    sheet_symbol = sheetName.split("_")[0]
    hdrs_rowIdx = res[0][0]
    hdrs = res[0][1][:ignoreHdr_idxDic]
    eff_hdrs = list(map(lambda x: x[1], filter(lambda x: x[1]!=None, enumerate(hdrs))))[1:]
    eff_hdrs_col_idx = list(map(lambda x: x[0], filter(lambda x: x[1]!=None, enumerate(hdrs))))[1:]
    sheetDic = {
        "sheet_symbol": sheet_symbol,
        "sheet_name": sheetName,
        "hdrs_rowIdx": hdrs_rowIdx,
        "hdrs": hdrs,
        "eff_hdrs": eff_hdrs,
        "eff_hdrs_col_idx": eff_hdrs_col_idx,
        "srcDatas": sheetDatas,
    }
    return sheetDic

def get_sheet_effDatas(sheetDic):
    sheetDatas = sheetDic["srcDatas"]
    eff_sheet_datas = []
    for row in sheetDatas:
        eff_row = []
        for idx in sheetDic["eff_hdrs_col_idx"]:
            eff_row.append(row[idx])
        eff_sheet_datas.append(eff_row)
    
    sheetDic["eff_sheet_datas"] = eff_sheet_datas[sheetDic["hdrs_rowIdx"]:]
    
    return sheetDic

sheetDic = get_sheetHeaders(sheetName, sheetDatas, ignoreHdr_idxDic)

res = get_sheet_effDatas(sheetDic)
# Assign your output to the OUT variable.

OUT = res
# ----------------------------------------
code_block_5 = CodeBlock(sheetDic=parse_시트_as_dict__only_int_debug) { sheetDic; }
code_block_6 = CodeBlock(sheetDic=code_block_5) { sheetDic["eff_sheet_datas"]; }
fields = ScheduleView.Fields(scheduleView=code_block)

# group: key schedule
code_block_7 = CodeBlock(viewSchedule=code_block) { _viewSchedule: var[]..[]; }
code_block_8 = CodeBlock(data=code_block_6) { _data: var[]..[]; }
code_block_9 = CodeBlock(parameterNames=fields) { _parameterNames: var[]..[]; }
python_script = Python(IN[0]=code_block_7, IN[1]=code_block_8, IN[2]=code_block_9)  # CPython3
# ---------- python_script.python (69 lines) ----------
#Copyright(c) 2015, Konrad Sobon
# @arch_laboratory, http://archi-lab.net

import clr
clr.AddReference('ProtoGeometry')
from Autodesk.DesignScript.Geometry import *

# Import DocumentManager and TransactionManager
clr.AddReference("RevitServices")
import RevitServices
from RevitServices.Persistence import DocumentManager
from RevitServices.Transactions import TransactionManager

# Import RevitAPI
clr.AddReference("RevitAPI")
import Autodesk
from Autodesk.Revit.DB import *

doc = DocumentManager.Instance.CurrentDBDocument
uiapp = DocumentManager.Instance.CurrentUIApplication
app = uiapp.Application

from System.Collections.Generic import *

# Import ToDSType(bool) extension method
clr.AddReference("RevitNodes")
import Revit
clr.ImportExtensions(Revit.Elements)

#The inputs to this node will be stored as a list in the IN variable.
dataEnteringNode = IN

keySchedule = UnwrapElement(IN[0])
data = IN[1]
inputParams = IN[2]

# "Start" the transaction
TransactionManager.Instance.EnsureInTransaction(doc)

test = []
count = []
cellParams = [[] for i in range(len(data))]
if any(isinstance(item, list) for item in data):
	# process list of lists
	for i in data:
		count.append(len(i))
	colCount = max(count)
	colAvailable = len(keySchedule.Definition.GetSchedulableFields())
	if colCount > colAvailable:
		message = "Please add/remove parameters to/from schedule so that they match longest data set."
	else:
		tableData = keySchedule.GetTableData()
		sectionData = tableData.GetSectionData(SectionType.Body)
		if sectionData.NumberOfRows - 2 <= len(data):
			# schedule by default will have 2 rows (A, B, C and Header Names)
			rowsToAdd = (len(data) - sectionData.NumberOfRows) + 2
			for i in range(0, rowsToAdd, 1):
				sectionData.InsertRow(0)
		else:
			# schedule when updating might already have too many rows 
			rowsToDelete = sectionData.NumberOfRows - 2 - len(data)
			for i in reversed(range(sectionData.NumberOfRows - rowsToDelete, sectionData.NumberOfRows, 1)):
				sectionData.RemoveRow(i)

# "End" the transaction
TransactionManager.Instance.TransactionTaskDone()

#Assign your output to the OUT variable
OUT = keySchedule
# ----------------------------------------
code_block_10 = CodeBlock { _upperCase: bool = false; }
python_script_2 = Python(IN[0]=python_script, IN[1]=code_block_8, IN[2]=code_block_9, IN[3]=code_block_10)  # CPython3
# ---------- python_script_2.python (99 lines) ----------
#Copyright(c) 2015, Konrad Sobon
# @arch_laboratory, http://archi-lab.net

import clr
import sys
clr.AddReference('ProtoGeometry')
from Autodesk.DesignScript.Geometry import *

# Import DocumentManager and TransactionManager
clr.AddReference("RevitServices")
import RevitServices
from RevitServices.Persistence import DocumentManager
from RevitServices.Transactions import TransactionManager

# Import RevitAPI
clr.AddReference("RevitAPI")
import Autodesk
from Autodesk.Revit.DB import *

doc = DocumentManager.Instance.CurrentDBDocument
uiapp = DocumentManager.Instance.CurrentUIApplication
app = uiapp.Application

from System.Collections.Generic import *

# Import ToDSType(bool) extension method
clr.AddReference("RevitNodes")
import Revit
clr.ImportExtensions(Revit.Elements)

#pyt_path = r'C:\Program Files (x86)\IronPython 2.7\Lib'
#sys.path.append(pyt_path)
import re

#The inputs to this node will be stored as a list in the IN variable.
dataEnteringNode = IN

keySchedule = UnwrapElement(IN[0])
data = IN[1]
inputParams = IN[2]
upper = IN[3]

def set_keySchedule(keySchedule, data, inputParams, upper):
    # "Start" the transaction
    TransactionManager.Instance.EnsureInTransaction(doc)
    
    tableData = keySchedule.GetTableData()
    sectionData = tableData.GetSectionData(SectionType.Body)
    
    keyNames = []
    for i in range(1,sectionData.NumberOfRows - 1,1):
    	keyNames.append(str(int(i)))
    
    allKeys = FilteredElementCollector(doc).WhereElementIsNotElementType()
    params = [[] for i in range(len(keyNames))]
    test = []
    for key in allKeys:
    	try:
    		if key.get_Parameter(BuiltInParameter.REF_TABLE_ELEM_NAME).AsString() in keyNames and key.OwnerViewId == keySchedule.Id:
    			indexValue = keyNames.index(key.get_Parameter(BuiltInParameter.REF_TABLE_ELEM_NAME).AsString())
    			for i in range(0, len(inputParams),1):
    				params[indexValue].extend(key.GetParameters(str(inputParams[i])))
    	except:
    		pass
    
    for i, j in zip(params, data):
    	for param, value in zip(i,j):
    		if isinstance(value, str):
    			#valueDecoded = value.decode('string_escape')
    			#valueDecoded = value.encode('utf-8').decode('unicode-escape')
    			valueDecoded = str(value).encode('utf-8').decode(encoding='UTF-8', errors='strict')
    		else:
    			if value == None:
    				valueDecoded = " "
    			else:
    				#valueDecoded = str(value).decode('string_escape')
    				#valueDecoded = str(value).encode('utf-8').decode('unicode-escape')
    				valueDecoded = str(value).encode('utf-8').decode(encoding='UTF-8', errors='strict')
    		if upper:
    			valueDecoded = valueDecoded.upper()
    			param.Set(valueDecoded)
    		else:
    			param.Set(valueDecoded)
    
    
    # "End" the transaction
    TransactionManager.Instance.TransactionTaskDone()
    #return keySchedule

def get_final_result(keySchedule, data, inputParams, upper):
    if keySchedule == []:
        res = []
    else:
        set_keySchedule(keySchedule, data, inputParams, upper)
        res = keySchedule
    return res

#Assign your output to the OUT variable
OUT = get_final_result(keySchedule, data, inputParams, upper)
# ----------------------------------------
code_block_11 = CodeBlock(viewSchedule=python_script_2) { _viewSchedule; }

code_block_12 = CodeBlock { "K"; }
n1_select_schedule = CustomSelection("H_Key Schedule_Window", items={A_Key Schedule(Floor): "A_Key Schedule(Floor)", B_Key Schedule(Skirt): "B_Key Schedule(Skirt)", C_Key Schedule(Wall): "C_Key Schedule(Wall)", D_Key Schedule(Ceiling): "D_Key Schedule(Ceiling)", E_Key Schedule_Wall: "E_Key Schedule_Wall", F_Key Schedule_Roof: "F_Key Schedule_Roof", G_Key Schedule_Door: "G_Key Schedule_Door", H_Key Schedule_Window: "H_Key Schedule_Window"})  # "1. Select Schedule"; graph input
name_2 = Element.Name(element=filterByBoolMask.in)
sortByKey = List.SortByKey(list=filterByBoolMask.in, keys=name_2)
code_block_13 = CodeBlock { "_"; }
split = String.Split(string=sortByKey.sortedKeys, separator0=code_block_13)
firstItem = List.FirstItem(list=split@L2)
code_block_14 = CodeBlock(sheetDic=code_block_5) { sheetDic["sheet_symbol"]; }
indexOf = List.IndexOf(list=firstItem, element=code_block_14)
target_schedule = List.GetItemAtIndex(list=sortByKey.sortedList, index=indexOf)

# group: 추후 범용 시트 입력 부 구현 예정
n2_input_other_schedule = StringInput("Finish (Floor)")  # "2. Input Other Schedule"
code_block_15 = CodeBlock(otherScheduleName=n2_input_other_schedule) { otherScheduleName; }
