# Dynamo graph [H_PAB.RT.B1]_Revit 입찰 프레임 자동생성_[3.0.0].dyn "#1_Bid_Draft Model_Automation_1.0.0" (Dynamo 2.16.1.2727)
# Create Draft Modeling in Plant-Architecture Bidding Stage

# note: 바닥 및 지붕 모델링

# group: 그리드 필터
categories = Categories("OST_Grids")
all_elements_of_category = ElementsOfCategory(Category=categories)
string = StringInput("Name")
parameterByName = Parameter.ParameterByName(element=all_elements_of_category, name=string)
value = Parameter.Value(parameter=parameterByName)
string_2 = StringInput("x")
boolean = BoolSelector(true)
contains = String.Contains(string=value, searchFor=string_2, ignoreCase=boolean)
string_3 = StringInput("y")
contains_2 = String.Contains(string=value, searchFor=string_3, ignoreCase=boolean)
eq = contains == contains_2
boolean_2 = BoolSelector(false)
allIndicesOf = List.AllIndicesOf(list=eq, item=boolean_2)
getItemAtIndex = List.GetItemAtIndex(list=all_elements_of_category, index=allIndicesOf)
curve = Grid.Curve(grid=getItemAtIndex)

# group: 그리드 방향 조정 ( + : → ↑ )
startPoint = Curve.StartPoint(curve=curve)
endPoint = Curve.EndPoint(curve=curve)
byTwoPoints = Vector.ByTwoPoints(start=startPoint, end=endPoint)
normalized = Vector.Normalized(vector=byTwoPoints)
X = Vector.X(vector=normalized)
round = Math.Round(number=X)
number = DoubleInput(-1)
eq_2 = round == number
Y = Vector.Y(vector=normalized)
round_2 = Math.Round(number=Y)
eq_3 = round_2 == number
eq_4 = eq_2 == eq_3
filterByBoolMask = List.FilterByBoolMask(list=curve, mask=eq_4)
reverse = Curve.Reverse(curve=filterByBoolMask.out)
join = List.Join(list0=filterByBoolMask.in, list1=reverse)

# group: 그리드 교차점 추출
intersect = Geometry.Intersect(geometry=join, other=join, lacing=CrossProduct)
flatten = List.Flatten(list=intersect)
type = Object.Type(object=flatten)
string_4 = StringInput("point")
boolean_3 = BoolSelector(true)
contains_3 = String.Contains(string=type, searchFor=string_4, ignoreCase=boolean_3)
allIndicesOf_2 = List.AllIndicesOf(list=contains_3, item=boolean_3)
getItemAtIndex_2 = List.GetItemAtIndex(list=flatten, index=allIndicesOf_2)
pruneDuplicates = Point.PruneDuplicates(points=getItemAtIndex_2)

# group: 레벨 데이터 정리
categories_2 = Categories("OST_Levels")
all_elements_of_category_2 = ElementsOfCategory(Category=categories_2)
elevation = Level.Elevation(level=all_elements_of_category_2)
sort = List.Sort(list=elevation)
indexOf = List.IndexOf(list=elevation, element=sort)
getItemAtIndex_3 = List.GetItemAtIndex(list=all_elements_of_category_2, index=indexOf)
name = Level.Name(level=getItemAtIndex_3)
string_5 = StringInput("BOF")
boolean_4 = BoolSelector(true)
contains_4 = String.Contains(string=name, searchFor=string_5, ignoreCase=boolean_4)
filterByBoolMask_2 = List.FilterByBoolMask(list=getItemAtIndex_3, mask=contains_4)
count = List.Count(list=filterByBoolMask_2.out)
code_block = CodeBlock(n=count) { n-1; }
removeItemAtIndex = List.RemoveItemAtIndex(list=filterByBoolMask_2.out, indices=code_block)
restOfItems = List.RestOfItems(list=filterByBoolMask_2.out)
lastItem = List.LastItem(list=filterByBoolMask_2.out)

# group: 독립기초 패밀리 선택
n3_select_foundation_types = FamilyTypes("Foundation Rectangular (Non-Pile):H_SF_AR_S18_W2400xL2400xT500_Bitumen")  # "3. Select : Foundation Types"; graph input

number_2 = DoubleInput(1)

# group: 기둥 패밀리 선택
n4_select_pedestal_types = StructuralColumnTypes("H_SC_ACC_UG PED_W600xL600")  # "4. Select : Pedestal Types"; graph input

string_6 = StringInput("Base Offset")
string_7 = StringInput("Top Offset")
join_2 = List.Join()  # unwired: list0, list1, list2
code_block_2 = CodeBlock(levels=filterByBoolMask_2.out) { levels; }
elevation_2 = Level.Elevation(level=code_block_2)
sortByKey = List.SortByKey(list=code_block_2, keys=elevation_2)
reverse_2 = List.Reverse(list=sortByKey.sortedList)

# group: 기둥 패밀리 선택
n5_select_structural_column_types = StructuralColumnTypes("H_SC_ACC_W600xL600")  # "5. Select : Structural Column Types"; graph input

# group: 기둥 모델링
Z = Point.Z(point=pruneDuplicates)
number_3 = DoubleInput(-1)
mul = Z * number_3
translate = Geometry.Translate(geometry=pruneDuplicates, zTranslation=mul, lacing=Shortest)
elevation_3 = Level.Elevation(level=filterByBoolMask_2.out)
number_4 = DoubleInput(1)
round_3 = Math.Round(number=elevation_3, digits=number_4)
translate_2 = Geometry.Translate(geometry=translate, zTranslation=round_3, lacing=CrossProduct)
byPoints = PolyCurve.ByPoints(points=translate_2)
curves = PolyCurve.Curves(polyCurve=byPoints)

# group: Pedestal & 독립기초 모델링
firstItem = List.FirstItem(list=translate_2@L2)
elevation_4 = Level.Elevation(level=filterByBoolMask_2.in)
string_8 = StringInput("Foundation Thickness")
parameterByName_2 = Parameter.ParameterByName(element=n3_select_foundation_types, name=string_8)
value_2 = Parameter.Value(parameter=parameterByName_2)
add = elevation_4 + value_2
string_9 = StringInput("Height Offset From Level")

round_4 = Math.Round(number=add, digits=number_2)

# group (continued): Pedestal & 독립기초 모델링
translate_3 = Geometry.Translate(geometry=firstItem, zTranslation=round_4, lacing=CrossProduct)
byStartPointEndPoint = Line.ByStartPointEndPoint(startPoint=translate_3, endPoint=firstItem, lacing=Shortest)
flatten_2 = List.Flatten(list=byStartPointEndPoint)
columnByCurve = StructuralFraming.ColumnByCurve(curve=flatten_2, level=filterByBoolMask_2.in, structuralColumnType=n4_select_pedestal_types, lacing=CrossProduct)
flatten_3 = List.Flatten(list=translate_3)
byPointAndLevel = FamilyInstance.ByPointAndLevel(familyType=n3_select_foundation_types, point=flatten_3, level=filterByBoolMask_2.in, lacing=CrossProduct)
setParameterByName = Element.SetParameterByName(element=byPointAndLevel, parameterName=string_9, value=value_2, lacing=CrossProduct)

code_block_3 = CodeBlock(fdnThk=value_2) { fdnThk; 0; }
setParameterByName_2 = Element.SetParameterByName(element=columnByCurve, parameterName=string_6, value=code_block_3.fdnThk, lacing=CrossProduct)
setParameterByName_3 = Element.SetParameterByName(element=setParameterByName_2, parameterName=string_7, value=code_block_3.out1, lacing=CrossProduct)
solids = Element.Solids(element=setParameterByName_3)
flatten_4 = List.Flatten(list=solids)
byUnion = Solid.ByUnion(solids=flatten_4)
python_script = Python(IN[0]=translate_2)  # CPython3
# ---------- python_script.python (19 lines) ----------
# Load the Python Standard and DesignScript Libraries
import sys
import clr
clr.AddReference('ProtoGeometry')
from Autodesk.DesignScript.Geometry import *

# The inputs to this node will be stored as a list in the IN variables.
dataEnteringNode = IN
gridPtsGrps = IN[0]
# Place your code below this line

def getPoint_SttEndPair(ptsGrp):
    rngs = range(len(ptsGrp)-1)
    combi = list(map(lambda x: Line.ByStartPointEndPoint(ptsGrp[x],ptsGrp[x+1]),rngs))
    
    return combi

# Assign your output to the OUT variable.
OUT = map(getPoint_SttEndPair, gridPtsGrps)
# ----------------------------------------

# group (continued): 기둥 모델링
transpose = List.Transpose(lists=python_script)
columnByCurve_2 = StructuralFraming.ColumnByCurve(curve=transpose, level=removeItemAtIndex, structuralColumnType=n5_select_structural_column_types)

count_2 = List.Count(list=columnByCurve_2)
takeItems = List.TakeItems(list=reverse_2, amount=count_2)
reverse_3 = List.Reverse(list=takeItems)
층별기둥_높이_조정 = Python(IN[0]=reverse_3, IN[1]=columnByCurve_2)  # CPython3
# ---------- 층별기둥_높이_조정.python (20 lines) ----------
# Load the Python Standard and DesignScript Libraries
import sys
import clr
clr.AddReference('ProtoGeometry')
from Autodesk.DesignScript.Geometry import *

# The inputs to this node will be stored as a list in the IN variables.
dataEnteringNode = IN
levels = IN[0]
columnGrps = IN[1]
grp_level_pairs = list(zip(columnGrps,levels))

# Place your code below this line

def setParam_grp(grp,level):
    res = list(map(lambda x: x.SetParameterByName("Top Level",level),grp))
    return res

# Assign your output to the OUT variable.
OUT = map(lambda x: setParam_grp(*x), grp_level_pairs)
# ----------------------------------------

# group: 기둥 오프셋값 조정
string_10 = StringInput("Base Offset")
code_block_4 = CodeBlock { 0; }
setParameterByName_4 = Element.SetParameterByName(element=층별기둥_높이_조정, parameterName=string_10, value=code_block_4, lacing=CrossProduct)
string_11 = StringInput("Top Offset")
setParameterByName_5 = Element.SetParameterByName(element=setParameterByName_4, parameterName=string_11, value=code_block_4, lacing=CrossProduct)

# group: 벽체 정보 불러오기 (레벨 별)
categories_3 = Categories("OST_Walls")
all_elements_of_category_3 = ElementsOfCategory(Category=categories_3)
getLocation = Element.GetLocation(element=all_elements_of_category_3)
number_5 = DoubleInput(0.5)
pointAtParameter = Curve.PointAtParameter(curve=getLocation, param=number_5)
Z_2 = Point.Z(point=pointAtParameter)
round_5 = Math.Round(number=Z_2)
elevation_5 = Level.Elevation(level=removeItemAtIndex)
round_6 = Math.Round(number=elevation_5)
allIndicesOf_3 = List.AllIndicesOf(list=round_5, item=round_6)
# note: 루프층 제외한 벽 모델
getItemAtIndex_4 = List.GetItemAtIndex(list=all_elements_of_category_3, index=allIndicesOf_3)
uniqueItems = List.UniqueItems(list=round_5)
allIndicesOf_4 = List.AllIndicesOf(list=round_5, item=uniqueItems)
# note: 레벨 별 모든 벽 모델
getItemAtIndex_5 = List.GetItemAtIndex(list=all_elements_of_category_3, index=allIndicesOf_4)

# group: 그리드 간 교차점으로 그리드 분할 => 보 Curve 작성
intersect_2 = Geometry.Intersect(geometry=join, other=pruneDuplicates, lacing=CrossProduct)
flatten_5 = List.Flatten(list=intersect_2@L3)
parameterAtPoint = Curve.ParameterAtPoint(curve=join, point=flatten_5, lacing=Shortest)
sort_2 = List.Sort(list=parameterAtPoint)
indexOf_2 = List.IndexOf(list=parameterAtPoint, element=sort_2, lacing=Shortest)
getItemAtIndex_6 = List.GetItemAtIndex(list=flatten_5, index=indexOf_2, lacing=Shortest)
byPoints_2 = PolyCurve.ByPoints(points=getItemAtIndex_6)
curves_2 = PolyCurve.Curves(polyCurve=byPoints_2)

code_block_5 = CodeBlock(levels=restOfItems) { levels; }

# group: 보 패밀리 선택
n6_select_structural_framing = StructuralFramingTypes("H_SB_ACB_B300xH600")  # "6. Select : Structural Framing Types"; graph input

# group: 보 모델링
flatten_6 = List.Flatten(list=curves_2)
elevation_6 = Level.Elevation(level=code_block_5)
number_6 = DoubleInput(1)
round_7 = Math.Round(number=elevation_6, digits=number_6)
translate_4 = Geometry.Translate(geometry=flatten_6, zTranslation=round_7, lacing=CrossProduct)
transpose_2 = List.Transpose(lists=translate_4)
beamByCurve = StructuralFraming.BeamByCurve(curve=transpose_2, level=removeItemAtIndex, structuralFramingType=n6_select_structural_framing)
string_12 = StringInput("y Offset Value")
number_7 = DoubleInput(0)
setParameterByName_6 = Element.SetParameterByName(element=beamByCurve, parameterName=string_12, value=number_7, lacing=CrossProduct)

code_block_6 = CodeBlock { "Reference Level"; }
code_block_7 = CodeBlock(levels=code_block_5) { levels; }
setParameterByName_7 = Element.SetParameterByName(element=setParameterByName_6@L2, parameterName=code_block_6, value=code_block_7@L1)
code_block_8 = CodeBlock { "Start Level Offset"; "End Level Offset"; 0; }
setParameterByName_8 = Element.SetParameterByName(element=setParameterByName_7, parameterName=code_block_8.out0, value=code_block_8.out2, lacing=CrossProduct)
setParameterByName_9 = Element.SetParameterByName(element=setParameterByName_8, parameterName=code_block_8.out1, value=code_block_8.out2, lacing=CrossProduct)
combine = List.Combine(combineFunction=join_2, list0=setParameterByName_5, list1=getItemAtIndex_4, list2=setParameterByName_9)
solids_2 = Element.Solids(element=combine)
flatten_7 = List.Flatten(list=solids_2@L3)
byUnion_2 = Solid.ByUnion(solids=flatten_7)
join_3 = List.Join(list0=byUnion, list1=byUnion_2)
byGeometry = BoundingBox.ByGeometry(geom=join_3, lacing=Shortest)
toCuboid = BoundingBox.ToCuboid(boundingBox=byGeometry)
bySolid = PolySurface.BySolid(solid=toCuboid)
surfaces = PolySurface.Surfaces(polySurface=bySolid)
join_4 = List.Join()  # unwired: list0, list1
number_8 = DoubleInput(0.5)
normalAtParameter = Surface.NormalAtParameter(surface=surfaces, u=number_8, v=number_8)
Z_3 = Vector.Z(vector=normalAtParameter)
number_9 = DoubleInput(-1)
eq_5 = Z_3 == number_9
boolean_5 = BoolSelector(true)
allIndicesOf_5 = List.AllIndicesOf(list=eq_5, item=boolean_5, lacing=CrossProduct)
number_10 = DoubleInput(1)
eq_6 = Z_3 == number_10
allIndicesOf_6 = List.AllIndicesOf(list=eq_6, item=boolean_5, lacing=CrossProduct)
combine_2 = List.Combine(combineFunction=join_4, list0=allIndicesOf_5, list1=allIndicesOf_6)
removeItemAtIndex_2 = List.RemoveItemAtIndex(list=surfaces, indices=combine_2, lacing=Shortest)
flatten_8 = List.Flatten(list=removeItemAtIndex_2)
byJoinedSurfaces = PolySurface.ByJoinedSurfaces(surfaces=flatten_8)
getItemAtIndex_7 = List.GetItemAtIndex(list=surfaces, index=allIndicesOf_6, lacing=Shortest)
flatten_9 = List.Flatten(list=getItemAtIndex_7)
lastItem_2 = List.LastItem(list=flatten_9)
perimeterCurves = Surface.PerimeterCurves(surface=lastItem_2)

# group: 지붕 패밀리 선택
n1_select_roof_types = RoofTypes("H_RF_AMF_RC Roof Finish_WP_Insulation_Protection")  # "1. Select: Roof Types"; graph input

byOutlineTypeAndLevel = Roof.ByOutlineTypeAndLevel(outline=perimeterCurves, roofType=n1_select_roof_types, level=lastItem)

# group: 지붕 레벨 조정
string_13 = StringInput("Base Offset From Level")
string_14 = StringInput("Thickness")
parameterByName_3 = Parameter.ParameterByName(element=byOutlineTypeAndLevel, name=string_14)
value_3 = Parameter.Value(parameter=parameterByName_3)
number_11 = DoubleInput(-1)
mul_2 = value_3 * number_11
setParameterByName_10 = Element.SetParameterByName(element=byOutlineTypeAndLevel, parameterName=string_13, value=mul_2)

# group: 객체 우선순위 설정
unjoinAllGeometry = Element.UnjoinAllGeometry(elements=setParameterByName_10)  # frozen
lastItem_3 = List.LastItem(list=setParameterByName_5)  # frozen
lastItem_4 = List.LastItem(list=setParameterByName_7)  # frozen
join_5 = List.Join(list0=lastItem_3, list1=lastItem_4)
joinGeometry = Element.JoinGeometry(element=unjoinAllGeometry, otherElement=join_5, lacing=CrossProduct)
flatten_10 = List.Flatten(list=joinGeometry@L2)
restOfItems_2 = List.RestOfItems(list=flatten_10@L2)
flatten_11 = List.Flatten(list=restOfItems_2)
setGeometryJoinOrder = Element.SetGeometryJoinOrder(cuttingElement=flatten_11, otherElement=unjoinAllGeometry, lacing=CrossProduct)
lastItem_5 = List.LastItem(list=getItemAtIndex_4)  # frozen

# group: 타이거더 Curve 작성
flatten_12 = List.Flatten(list=getItemAtIndex_6)
X_2 = Point.X(point=flatten_12)
round_8 = Math.Round(number=X_2)
maximumItem = List.MaximumItem(list=round_8)
allIndicesOf_7 = List.AllIndicesOf(list=round_8, item=maximumItem)
minimumItem = List.MinimumItem(list=round_8)
allIndicesOf_8 = List.AllIndicesOf(list=round_8, item=minimumItem)
Y_2 = Point.Y(point=flatten_12)
round_9 = Math.Round(number=Y_2)
maximumItem_2 = List.MaximumItem(list=round_9)
allIndicesOf_9 = List.AllIndicesOf(list=round_9, item=maximumItem_2)
minimumItem_2 = List.MinimumItem(list=round_9)
allIndicesOf_10 = List.AllIndicesOf(list=round_9, item=minimumItem_2)
list_create = List.Create(item0=allIndicesOf_7, item1=allIndicesOf_8, item2=allIndicesOf_9, item3=allIndicesOf_10)
getItemAtIndex_8 = List.GetItemAtIndex(list=flatten_12, index=list_create)
pruneDuplicates_2 = Point.PruneDuplicates(points=getItemAtIndex_8@L2)
byPoints_3 = PolyCurve.ByPoints(points=pruneDuplicates_2)
curves_3 = PolyCurve.Curves(polyCurve=byPoints_3)

# group: TG 패밀리 선택
n7_select_tie_girder_types = StructuralFramingTypes("H_SB_ACB_TG_B400xH600")  # "7. Select : Tie Girder Types"; graph input

# group: 타이거더 모델링
firstItem_2 = List.FirstItem(list=removeItemAtIndex)
elevation_7 = Level.Elevation(level=firstItem_2)
translate_5 = Geometry.Translate(geometry=curves_3, zTranslation=elevation_7, lacing=CrossProduct)
beamByCurve_2 = StructuralFraming.BeamByCurve(curve=translate_5, level=firstItem_2, structuralFramingType=n7_select_tie_girder_types)

string_15 = StringInput("y Offset Value")
number_12 = DoubleInput(0)
setParameterByName_11 = Element.SetParameterByName(element=beamByCurve_2, parameterName=string_15, value=number_12, lacing=CrossProduct)
code_block_9 = CodeBlock { "Start Level Offset"; "End Level Offset"; 0; }
setParameterByName_12 = Element.SetParameterByName(element=setParameterByName_11, parameterName=code_block_9.out0, value=code_block_9.out2, lacing=CrossProduct)
setParameterByName_13 = Element.SetParameterByName(element=setParameterByName_12, parameterName=code_block_9.out1, value=code_block_9.out2, lacing=CrossProduct)

# group (continued): 타이거더 모델링
flatten_13 = List.Flatten(list=setParameterByName_13)

# group: 페데스탈 & 타이거더 형상 결합
flatten_14 = List.Flatten(list=setParameterByName_3)  # frozen
firstItem_3 = List.FirstItem(list=flatten_13)  # frozen
getCategory = Element.GetCategory(element=firstItem_3)
getIntersectingElementsOfCategory = Element.GetIntersectingElementsOfCategory(element=flatten_14, category=getCategory)
joinGeometry_2 = Element.JoinGeometry(element=flatten_14, otherElement=getIntersectingElementsOfCategory)

getItemAtIndex_9 = List.GetItemAtIndex(list=surfaces, index=allIndicesOf_5, lacing=Shortest)
flatten_15 = List.Flatten(list=getItemAtIndex_9)
restOfItems_3 = List.RestOfItems(list=flatten_15)
perimeterCurves_2 = Surface.PerimeterCurves(surface=restOfItems_3)

# group: 기초(바닥) 패밀리 선택
n2_select_floor_types = FloorTypes("H_FL_AMF_RC Slab_T150")  # "2. Select : Floor Types"; graph input

byOutlineTypeAndLevel_2 = Floor.ByOutlineTypeAndLevel(outlineCurves=perimeterCurves_2, floorType=n2_select_floor_types, level=removeItemAtIndex)

# group: Floor 레벨 조정
string_16 = StringInput("Height Offset From Level")
number_13 = DoubleInput(0)
setParameterByName_14 = Element.SetParameterByName(element=byOutlineTypeAndLevel_2, parameterName=string_16, value=number_13)

# group: 객체 우선순위 설정
unjoinAllGeometry_2 = Element.UnjoinAllGeometry(elements=byOutlineTypeAndLevel_2)  # frozen
join_6 = List.Join()  # frozen; unwired: list0, list1, list2
categories_4 = Categories("OST_Floors")
getIntersectingElementsOfCategory_2 = Element.GetIntersectingElementsOfCategory(element=setParameterByName_14, category=categories_4)
categories_5 = Categories("OST_StructuralColumns")
getIntersectingElementsOfCategory_3 = Element.GetIntersectingElementsOfCategory(element=setParameterByName_14, category=categories_5)
categories_6 = Categories("OST_StructuralFraming")
getIntersectingElementsOfCategory_4 = Element.GetIntersectingElementsOfCategory(element=setParameterByName_14, category=categories_6)
combine_3 = List.Combine(combineFunction=join_6, list0=getIntersectingElementsOfCategory_2, list1=getIntersectingElementsOfCategory_3, list2=getIntersectingElementsOfCategory_4)
joinGeometry_3 = Element.JoinGeometry(element=unjoinAllGeometry_2, otherElement=combine_3)
lastItem_6 = List.LastItem(list=joinGeometry_3@L2)
firstItem_4 = List.FirstItem(list=joinGeometry_3@L2)
setGeometryJoinOrder_2 = Element.SetGeometryJoinOrder(cuttingElement=lastItem_6, otherElement=firstItem_4, lacing=CrossProduct)

code_block_10 = CodeBlock()
# ---------- code_block_10.designscript (5 lines) ----------
[
"Start Level Offset",
"End Level Offset"
];
0;
# ----------------------------------------
byStartPointEndPoint_2 = Line.ByStartPointEndPoint()  # unwired: startPoint, endPoint
code_block_11 = CodeBlock(floors=setParameterByName_14) { floors; }

# group: floor - beam 결합순서
join_7 = List.Join(list0=code_block_11, list1=setParameterByName_10)
list_create_2 = List.Create(item0=flatten_13, item1=setParameterByName_9)
flatten_16 = List.Flatten(list=list_create_2)
joinGeometry_4 = Element.JoinGeometry(element=join_7, otherElement=flatten_16@L1)
firstItem_5 = List.FirstItem(list=joinGeometry_4@L2)
lastItem_7 = List.LastItem(list=joinGeometry_4@L2)
setGeometryJoinOrder_3 = Element.SetGeometryJoinOrder(cuttingElement=firstItem_5, otherElement=lastItem_7, lacing=CrossProduct)

flatten_17 = List.Flatten(list=setParameterByName_3)
list_create_3 = List.Create(item0=flatten_17, item1=층별기둥_높이_조정)
code_block_12 = CodeBlock(columns=list_create_3) { columns; }

# group: column - roof 결합순서
lastItem_8 = List.LastItem(list=code_block_12)
flatten_18 = List.Flatten(list=lastItem_8)
joinGeometry_5 = Element.JoinGeometry(element=setParameterByName_10, otherElement=flatten_18@L1)
firstItem_6 = List.FirstItem(list=joinGeometry_5@L2)
lastItem_9 = List.LastItem(list=joinGeometry_5@L2)
setGeometryJoinOrder_4 = Element.SetGeometryJoinOrder(cuttingElement=firstItem_6, otherElement=lastItem_9, lacing=CrossProduct)
