# Dynamo graph [H_PAB.RT.B2]_Revit 입찰 공칭룸사이즈 결정 및 스타일 주입기_[3.0.1].dyn (Dynamo 2.16.2.5624)
# author: MK Jang
# Check Building's all rooms size and inject the sizes into schedule

categories = Categories("OST_Rooms")
all_elements_of_category = ElementsOfCategory(Category=categories)

# group: check Rooms Width / Length
coreCenterBoundary = Room.CoreCenterBoundary(room=all_elements_of_category)
byJoinedCurves = PolyCurve.ByJoinedCurves(curves=coreCenterBoundary)
flatten = List.Flatten(list=byJoinedCurves)
byPatch = Surface.ByPatch(closedCurve=flatten)
code_block = CodeBlock { 100; }
thicken = Surface.Thicken(surface=byPatch, thickness=code_block)
boundingBox = Geometry.BoundingBox(geometry=thicken)
toCuboid = BoundingBox.ToCuboid(boundingBox=boundingBox)
width = Cuboid.Width(cuboid=toCuboid)
length = Cuboid.Length(cuboid=toCuboid)

# group: Wall 객체 쪽 스타일 정리
code_block_2 = CodeBlock { " |or| "; }
categories_2 = Categories("OST_Walls")  # frozen
all_elements_of_category_2 = ElementsOfCategory(Category=categories_2)
room_srfs = CodeBlock(roomSrfs=byPatch) { roomSrfs; }
geometry = Element.Geometry(element=all_elements_of_category_2)
flatten_2 = List.Flatten(list=geometry)
doesIntersect = Geometry.DoesIntersect(geometry=room_srfs, other=flatten_2, lacing=CrossProduct)
filterByBoolMask = List.FilterByBoolMask(list=all_elements_of_category_2, mask=doesIntersect@L2)
code_block_3 = CodeBlock(i=filterByBoolMask.in) { i; }
code_block_4 = CodeBlock()
# ---------- code_block_4.designscript (6 lines) ----------
[
"Wall Base Material-1",
"Wall Base Material-2",
"Wall Base Material-3",
"Wall Finish-Ex"
];
# ----------------------------------------
python_script = Python(IN[0]=code_block_3, IN[1]=code_block_4)  # CPython3; unwired: IN[2]
# ---------- python_script.python (24 lines) ----------
# Load the Python Standard and DesignScript Libraries
import sys
import clr
clr.AddReference('ProtoGeometry')
from Autodesk.DesignScript.Geometry import *

# The inputs to this node will be stored as a list in the IN variables.
dataEnteringNode = IN
wallsPerRoom = IN[0]
params = IN[1]
# Place your code below this line

def make_StyleString(wElem,params):
    values_ = map(lambda x: wElem.GetParameterValueByName(x),params)
    values = list(filter(lambda x: x != "",values_))
    res = "+".join(values)
    return res

def make_StyleStringPerRoom(wGrp,params):
    res = map(lambda x: make_StyleString(x,params), wGrp)
    return res

# Assign your output to the OUT variable.
OUT = map(lambda x: make_StyleStringPerRoom(x,params), wallsPerRoom)
# ----------------------------------------
uniqueItems = List.UniqueItems(list=python_script@L2)
join = String.Join(separator=code_block_2, string0=uniqueItems@L2)

# group: check Rooms Height
geometry_2 = Element.Geometry(element=all_elements_of_category)
flatten_3 = List.Flatten(list=geometry_2)
boundingBox_2 = Geometry.BoundingBox(geometry=flatten_3)
toCuboid_2 = BoundingBox.ToCuboid(boundingBox=boundingBox_2)
height = Cuboid.Height(cuboid=toCuboid_2)

room_size_정리 = Python(IN[0]=width, IN[1]=length, IN[2]=height)  # CPython3
# ---------- room_size_정리.python (20 lines) ----------
# Load the Python Standard and DesignScript Libraries
import sys
import clr
clr.AddReference('ProtoGeometry')
from Autodesk.DesignScript.Geometry import *

import math

# The inputs to this node will be stored as a list in the IN variables.
dataEnteringNode = IN
[ws, ls, hs] = [IN[0], IN[1], IN[2]]

# Place your code below this line

chk_size = lambda y: map(lambda x: math.floor(x/100)*100, y)
#chk_height = lambda y: map(lambda x: math.floor(x/100)*100, y)
chk_height = lambda y: map(lambda x: x, y)
res = [chk_size(ws), chk_size(ls), chk_height(hs)]
# Assign your output to the OUT variable.
OUT = list(zip(*res))
# ----------------------------------------
addItemToEnd = List.AddItemToEnd(item=join@L1, list=room_size_정리@L2)
code_block_5 = CodeBlock { 0; ">>"; }
insert = String.Insert(string=uniqueItems@L2, index=code_block_5.out0, toInsert=code_block_5.out1)
code_block_6 = CodeBlock(i=all_elements_of_category) { i; }
code_block_7 = CodeBlock()
# ---------- code_block_7.designscript (6 lines) ----------
[
"H_Room W",
"H_Room L",
"H_Room H or CH"
//,"Wall Base Style"
];
# ----------------------------------------
rooms_setparameter = Python(IN[0]=code_block_6, IN[1]=code_block_7, IN[2]=room_size_정리)  # CPython3
# ---------- rooms_setparameter.python (56 lines) ----------
# Load the Python Standard and DesignScript Libraries
import sys
import clr
clr.AddReference('ProtoGeometry')
from Autodesk.DesignScript.Geometry import *

from functools import reduce

#################################Module For Functional Programing#############################################
curry = lambda f: lambda a,*args: f(a, *args) if (len(args)) else lambda *args: f(a, *args)

filter = curry(filter)
map = curry(map)

def _take(length, iter):
    res = []
    for a in iter:
        res.append(a)
        if len(res) == length:
            return res
        
take = curry(_take)
reduce = curry(reduce)

go = lambda *args: reduce(lambda a,f: f(a), args) ## 함수도 축약 가능 ##
##############################################################################################################

# The inputs to this node will be stored as a list in the IN variables.
dataEnteringNode = IN
rooms = IN[0]
params = IN[1]
sizes = IN[2]
# Place your code below this line

size_withParams = map(lambda x: dict(zip(params, x)) , sizes)
rooms_withSizes = list(zip(rooms, size_withParams))

setParamsAtAllRooms = lambda col: go\
(
    col,
    map(setParamsAtOneRoom),
    
)

def setParamsAtOneRoom(room_withSizes):
    room = room_withSizes[0]
    sizeDic = room_withSizes[1]
    paramName_andSizes = sizeDic.items()
    
    setParamRoom = lambda x: room.SetParameterByName(x[0],x[1])
    
    return map(setParamRoom,paramName_andSizes)
    

# Assign your output to the OUT variable.
OUT = setParamsAtAllRooms(rooms_withSizes)
# ----------------------------------------
watch = Watch(rooms_setparameter)  # graph output
categories_3 = Categories("OST_GenericModel")
categories_4 = Categories("OST_Materials")
all_elements_of_category_3 = ElementsOfCategory(Category=categories_4)
code_block_8 = CodeBlock(i=all_elements_of_category_3) { i[0]; }
code_block_9 = CodeBlock { "Rooms_directShape"; }
byGeometry = DirectShape.ByGeometry(geometry=flatten_3, category=categories_3, material=code_block_8, name=code_block_9)
parameters = Element.Parameters(element=byGeometry)
code_block_10 = CodeBlock { "Comments"; }
code_block_11 = CodeBlock { "Room Check View Only"; }
setParameterByName = Element.SetParameterByName(element=byGeometry, parameterName=code_block_10, value=code_block_11)
