# Dynamo graph [H_PAB.RT.B_]_Revit Schedule 주입기_[0.0.0].dyn (Dynamo 2.16.1.2727)
# author: MK Jang
# Inject Finish Style Data in Building List into Revit Key Schedule
# packages: archi-lab.net 2024.217.1024

# note: 시트중 최 상위 Row Idx를  행의 첫번째 값 문자열이 ':'를 포함하는 지 검사하는 것으로 로직 대체

n2_revit_schedule_명_입력 = StringInput("플랜트건축 3D Modeling Check Sheet")  # "2. Revit Schedule 명 입력"; graph input

# group: Filtering Finish Style Schedule
categories = Categories("OST_Schedules")
all_elements_of_category = ElementsOfCategory(Category=categories)
name = Element.Name(element=all_elements_of_category)
code_block = CodeBlock(i=name, j=n2_revit_schedule_명_입력) { i==j; }
filterByBoolMask = List.FilterByBoolMask(list=all_elements_of_category, mask=code_block)

firstItem = List.FirstItem(list=filterByBoolMask.in)
code_block_2 = CodeBlock { "Check"; }
n1_excel_시트명_입력 = StringInput("LE-Check-List")  # "1. Excel 시트명 입력"; graph input

# group: Import From Excel
n0_excel_경로 = Filename("..\..\..\OneDrive - 현대엔지니어링(주)\mkSpace\_000_HEC\2024\2024 기술과제계획서\1_BIM\20240604_Template에 체크시트 반영\(첨부 1)3D Modeling Check Sheet.xls")  # "0. Excel 경로"; graph input
file_from_path = FileObject(path=n0_excel_경로)
boolean = BoolSelector(true)
importExcel = Data.ImportExcel(file=file_from_path, sheetName=n1_excel_시트명_입력, showExcel=boolean)
code_block_3 = CodeBlock()
# ---------- code_block_3.designscript (7 lines) ----------
[
"Int Finish Style No"
,"Wall Style No"
,"Roof Style No"
,"Door Style No"
,"Window Style No"
];
# ----------------------------------------

header_row = DoubleInput(9)
header_index = CodeBlock(n=header_row) { n-1; }
code_block_4 = CodeBlock(x=importExcel, i=header_index) { x[i]; }
isNullOrEmpty = archilab.Core.Strings.IsNullOrEmpty(str=code_block_4)
filterByBoolMask_2 = List.FilterByBoolMask(list=code_block_4, mask=isNullOrEmpty)
code_block_5 = CodeBlock(i=filterByBoolMask_2.out)
# ---------- code_block_5.designscript (6 lines) ----------
[
i[2],
i[3],
i[4],
i[5]
];
# ----------------------------------------
indexOf = List.IndexOf(list=code_block_4, element=code_block_5)
getItemAtIndex = List.GetItemAtIndex(list=importExcel@L2, index=indexOf)
code_block_6 = CodeBlock { 10; }
dropItems = List.DropItems(list=getItemAtIndex, amount=code_block_6)
code_block_7 = CodeBlock { true; ""; }
isNull = Object.IsNull()  # unwired: object
replaceByCondition = Replace(item=dropItems, replaceWith=code_block_7.out1, condition=isNull)
code_block_8 = CodeBlock(i=replaceByCondition) { i==""; }
allTrue = List.AllTrue(list=code_block_8@L2)
filterByBoolMask_3 = List.FilterByBoolMask(list=replaceByCondition, mask=allTrue)
count = List.Count(list=filterByBoolMask_3.out)
cycle = List.Cycle(list=code_block_2, amount=count)
code_block_9 = CodeBlock(i=count) { 1; i; }
range = Range(start=code_block_9.out0, end=code_block_9.i)
string_from_object = FromObject(object=range)
list_create = List.Create(item0=cycle, item1=string_from_object)
transpose = List.Transpose(lists=list_create)
concat = String.Concat(string0=transpose)
transpose_2 = List.Transpose(lists=filterByBoolMask_3.out)
join = List.Join(list0=concat, list1=transpose_2)
transpose_3 = List.Transpose(lists=join)
fields = ScheduleView.Fields(scheduleView=firstItem)

# group: key schedule
code_block_10 = CodeBlock(viewSchedule=firstItem) { _viewSchedule: var[]..[]; }
code_block_11 = CodeBlock(data=transpose_3) { _data: var[]..[]; }
code_block_12 = CodeBlock(parameterNames=fields) { _parameterNames: var[]..[]; }
python_script = Python(IN[0]=code_block_10, IN[1]=code_block_11, IN[2]=code_block_12)  # CPython3
# ---------- python_script.python (69 lines) ----------
#Copyright(c) 2015, Konrad Sobon
# @arch_laboratory, http://archi-lab.net

import clr
clr.AddReference('ProtoGeometry')
from Autodesk.DesignScript.Geometry import *

# Import DocumentManager and TransactionManager
clr.AddReference("RevitServices")
import RevitServices
from RevitServices.Persistence import DocumentManager
from RevitServices.Transactions import TransactionManager

# Import RevitAPI
clr.AddReference("RevitAPI")
import Autodesk
from Autodesk.Revit.DB import *

doc = DocumentManager.Instance.CurrentDBDocument
uiapp = DocumentManager.Instance.CurrentUIApplication
app = uiapp.Application

from System.Collections.Generic import *

# Import ToDSType(bool) extension method
clr.AddReference("RevitNodes")
import Revit
clr.ImportExtensions(Revit.Elements)

#The inputs to this node will be stored as a list in the IN variable.
dataEnteringNode = IN

keySchedule = UnwrapElement(IN[0])
data = IN[1]
inputParams = IN[2]

# "Start" the transaction
TransactionManager.Instance.EnsureInTransaction(doc)

test = []
count = []
cellParams = [[] for i in range(len(data))]
if any(isinstance(item, list) for item in data):
	# process list of lists
	for i in data:
		count.append(len(i))
	colCount = max(count)
	colAvailable = len(keySchedule.Definition.GetSchedulableFields())
	if colCount > colAvailable:
		message = "Please add/remove parameters to/from schedule so that they match longest data set."
	else:
		tableData = keySchedule.GetTableData()
		sectionData = tableData.GetSectionData(SectionType.Body)
		if sectionData.NumberOfRows - 2 <= len(data):
			# schedule by default will have 2 rows (A, B, C and Header Names)
			rowsToAdd = (len(data) - sectionData.NumberOfRows) + 2
			for i in range(0, rowsToAdd, 1):
				sectionData.InsertRow(0)
		else:
			# schedule when updating might already have too many rows 
			rowsToDelete = sectionData.NumberOfRows - 2 - len(data)
			for i in reversed(range(sectionData.NumberOfRows - rowsToDelete, sectionData.NumberOfRows, 1)):
				sectionData.RemoveRow(i)

# "End" the transaction
TransactionManager.Instance.TransactionTaskDone()

#Assign your output to the OUT variable
OUT = keySchedule
# ----------------------------------------
code_block_13 = CodeBlock { _upperCase: bool = false; }
python_script_2 = Python(IN[0]=python_script, IN[1]=code_block_11, IN[2]=code_block_12, IN[3]=code_block_13)  # CPython3
# ---------- python_script_2.python (99 lines) ----------
#Copyright(c) 2015, Konrad Sobon
# @arch_laboratory, http://archi-lab.net

import clr
import sys
clr.AddReference('ProtoGeometry')
from Autodesk.DesignScript.Geometry import *

# Import DocumentManager and TransactionManager
clr.AddReference("RevitServices")
import RevitServices
from RevitServices.Persistence import DocumentManager
from RevitServices.Transactions import TransactionManager

# Import RevitAPI
clr.AddReference("RevitAPI")
import Autodesk
from Autodesk.Revit.DB import *

doc = DocumentManager.Instance.CurrentDBDocument
uiapp = DocumentManager.Instance.CurrentUIApplication
app = uiapp.Application

from System.Collections.Generic import *

# Import ToDSType(bool) extension method
clr.AddReference("RevitNodes")
import Revit
clr.ImportExtensions(Revit.Elements)

#pyt_path = r'C:\Program Files (x86)\IronPython 2.7\Lib'
#sys.path.append(pyt_path)
import re

#The inputs to this node will be stored as a list in the IN variable.
dataEnteringNode = IN

keySchedule = UnwrapElement(IN[0])
data = IN[1]
inputParams = IN[2]
upper = IN[3]

def set_keySchedule(keySchedule, data, inputParams, upper):
    # "Start" the transaction
    TransactionManager.Instance.EnsureInTransaction(doc)
    
    tableData = keySchedule.GetTableData()
    sectionData = tableData.GetSectionData(SectionType.Body)
    
    keyNames = []
    for i in range(1,sectionData.NumberOfRows - 1,1):
    	keyNames.append(str(int(i)))
    
    allKeys = FilteredElementCollector(doc).WhereElementIsNotElementType()
    params = [[] for i in range(len(keyNames))]
    test = []
    for key in allKeys:
    	try:
    		if key.get_Parameter(BuiltInParameter.REF_TABLE_ELEM_NAME).AsString() in keyNames and key.OwnerViewId == keySchedule.Id:
    			indexValue = keyNames.index(key.get_Parameter(BuiltInParameter.REF_TABLE_ELEM_NAME).AsString())
    			for i in range(0, len(inputParams),1):
    				params[indexValue].extend(key.GetParameters(str(inputParams[i])))
    	except:
    		pass
    
    for i, j in zip(params, data):
    	for param, value in zip(i,j):
    		if isinstance(value, str):
    			#valueDecoded = value.decode('string_escape')
    			#valueDecoded = value.encode('utf-8').decode('unicode-escape')
    			valueDecoded = str(value).encode('utf-8').decode(encoding='UTF-8', errors='strict')
    		else:
    			if value == None:
    				valueDecoded = " "
    			else:
    				#valueDecoded = str(value).decode('string_escape')
    				#valueDecoded = str(value).encode('utf-8').decode('unicode-escape')
    				valueDecoded = str(value).encode('utf-8').decode(encoding='UTF-8', errors='strict')
    		if upper:
    			valueDecoded = valueDecoded.upper()
    			param.Set(valueDecoded)
    		else:
    			param.Set(valueDecoded)
    
    
    # "End" the transaction
    TransactionManager.Instance.TransactionTaskDone()
    #return keySchedule

def get_final_result(keySchedule, data, inputParams, upper):
    if keySchedule == []:
        res = []
    else:
        set_keySchedule(keySchedule, data, inputParams, upper)
        res = keySchedule
    return res

#Assign your output to the OUT variable
OUT = get_final_result(keySchedule, data, inputParams, upper)
# ----------------------------------------
code_block_14 = CodeBlock(viewSchedule=python_script_2) { _viewSchedule; }

finish_category_선택 = CustomSelection("A_Key Schedule for Interior Finish (Floor)", items={A_Key Schedule for Interior Finish (Floor): "0", B_Key Schedule for Interior Finish (Skirt): "1", C_Key Schedule for Interior Finish (Wall): "2", D_Key Schedule for Interior Finish (Ceiling): "3", E_Key Schedule for Wall Style: "4", F_Key Schedule for Roof Style: "5", G_Key Schedule for Door Style: "6", H_Key Schedule for Window Style: "7"})
name_2 = Element.Name(element=filterByBoolMask.in)
sortByKey = List.SortByKey(list=filterByBoolMask.in, keys=name_2)
code_block_15 = CodeBlock(Finish_Category_Select=n2_revit_schedule_명_입력) { Finish_Category_Select; }
code_block_16 = CodeBlock(Finish_Category_Select=code_block_15) { Finish_Category_Select; }
watch = Watch()  # graph output; unwired: arg0
header_입력 = StringInput("NO.	ITEMS		DESCRIPTION			CHECKED		특이사항	Remark")  # frozen
header_row_2 = DoubleInput(9)
restOfItems = List.RestOfItems(list=filterByBoolMask_2.out)
join_2 = String.Join()  # unwired: separator, string0
