# Dynamo graph [H_PAB.RT.B_]_Revit Schedule 주입기_[1.0.1].dyn "keyschedule_내용 주입기_0.0.1" (Dynamo 3.3.0.6316)

n1_스케줄_명_입력 = StringInput("Ctrl+A 후 입력")  # "1. 스케줄 명 입력"; graph input
n2_내용입력 = StringInput("Ctrl+A 후 입력")  # "2. 내용입력"; graph input
python_script = Python(IN[0]=n1_스케줄_명_입력, IN[1]=n2_내용입력)  # CPython3; unwired: IN[2], IN[3], IN[4], IN[5]
# ---------- python_script.python (350 lines) ----------
# -*- coding: utf-8 -*-
import clr, re

# RevitServices
clr.AddReference('RevitServices')
from RevitServices.Persistence import DocumentManager
from RevitServices.Transactions import TransactionManager

# RevitAPI
clr.AddReference('RevitAPI')
from Autodesk.Revit.DB import (
    FilteredElementCollector, ViewSchedule, ScheduleSheetInstance,
    SectionType, ElementId, StorageType, Material, UnitUtils
)

doc = DocumentManager.Instance.CurrentDBDocument

# ---------- Inputs ----------
try:
    unwrap = UnwrapElement
except:
    def unwrap(x): return x

schedule_or_name   = unwrap(IN[0])
paste_text         = IN[1]
start_row          = IN[2] if len(IN) > 2 and IN[2] is not None else 0
write_col_start    = IN[3] if len(IN) > 3 and IN[3] is not None else 1   # 0=KeyName, 보통 1부터 값 채움
material_alias_map = IN[4] if len(IN) > 4 and IN[4] else {}
create_mode        = (IN[5] if len(IN) > 5 and IN[5] else "create").lower()  # "create" / "upsert"

# ---------- Helpers ----------
import re

def parse_table(text):
    if not isinstance(text, str) or not text.strip():
        return []

    # 줄바꿈 통일
    t = text.replace("\r\n", "\n").replace("\r", "\n").strip("\n")

    # 행 시작 패턴: 알파벳+숫자+하이픈 (예: A2-, B1-, C3- 등)
    row_start_pattern = re.compile(r"^[A-Z]+\d+-")

    # 전체 텍스트를 줄 단위로 나눔
    lines = t.split("\n")

    result = []
    current_row_lines = []

    for line in lines:
        # 탭 기준으로 셀 분리
        cells = line.split("\t")
        first_cell = cells[0].strip() if cells else ""

        # 행 시작 패턴이면 새로운 행 시작
        if row_start_pattern.match(first_cell):
            if current_row_lines:
                result.append(current_row_lines)
            current_row_lines = [line]
        else:
            current_row_lines.append(line)

    # 마지막 행 추가
    if current_row_lines:
        result.append(current_row_lines)

    # 각 행을 셀 단위로 정리
    parsed_rows = []
    for row_lines in result:
        merged_line = " // ".join(row_lines)
        cells = merged_line.split("\t")
        cleaned_cells = [re.sub(r"[\r\n]+", " // ", c.strip().strip('"').strip("'")) for c in cells]
        parsed_rows.append(cleaned_cells)

    return parsed_rows



def resolve_viewschedule(obj):
    if isinstance(obj, ViewSchedule): return obj, "ViewSchedule"
    try:
        if isinstance(obj, ScheduleSheetInstance):
            vs = doc.GetElement(obj.ScheduleId)
            if isinstance(vs, ViewSchedule): return vs, "ScheduleSheetInstance->ViewSchedule"
    except: pass
    if isinstance(obj, str):
        name = obj.strip()
        for v in FilteredElementCollector(doc).OfClass(ViewSchedule):
            if v.Name == name: return v, "ByName"
    return None, None

def get_sections(schedule):
    try: doc.Regenerate()
    except: pass
    td = schedule.GetTableData()
    header = td.GetSectionData(SectionType.Header)
    body   = td.GetSectionData(SectionType.Body)
    return header, body

def visible_fields(defn):
    idxs, fields = [], []
    for i in range(defn.GetFieldCount()):
        f = defn.GetField(i)
        if not getattr(f, "IsHidden", False):
            idxs.append(i); fields.append(f)
    return idxs, fields

def collect_key_elements(schedule):
    return list(FilteredElementCollector(doc, schedule.Id).WhereElementIsNotElementType().ToElements())

def material_by_name(name):
    if not name: return None
    real = material_alias_map.get(name, name)
    # 정확 일치
    for m in FilteredElementCollector(doc).OfClass(Material):
        if m.Name == real: return m
    # 대소문자 무시
    real_norm = real.strip().lower()
    for m in FilteredElementCollector(doc).OfClass(Material):
        if m.Name.strip().lower() == real_norm: return m
    return None

def set_param(param, text):
    if param is None or param.IsReadOnly: return False, "읽기전용/없음"
    st = param.StorageType
    try:
        if st == StorageType.String:
            return bool(param.Set(text or "")), None
        elif st == StorageType.Integer:
            iv = 0 if (text is None or text=="") else int(float(text))
            return bool(param.Set(iv)), None
        elif st == StorageType.Double:
            m = re.search(r"[-+]?\d*\.?\d+(?:[eE][-+]?\d+)?", text or "")
            val = float(m.group()) if m else 0.0
            try:
                ut = param.GetUnitTypeId()
                val_int = UnitUtils.ConvertToInternalUnits(val, ut)
            except:
                val_int = val
            return bool(param.Set(val_int)), None
        elif st == StorageType.ElementId:
            mat = material_by_name(text)
            if mat is not None:
                return bool(param.Set(mat.Id)), None
            if (text or "").strip()=="":
                return bool(param.Set(ElementId.InvalidElementId)), None
            return False, "ElementId 매핑 실패(재료 미발견)"
        else:
            return False, "미지원 StorageType"
    except Exception as ex:
        return False, str(ex)

# get_Parameter가 없는 환경 대응: 파라미터 안전 획득
def try_get_parameter(el, pid, sched_field=None):
    # 1) direct
    m = getattr(el, "get_Parameter", None)
    if callable(m):
        try:
            p = el.get_Parameter(pid)
            if p: return p
        except:
            pass
    # 2) enumerate
    try:
        for p in el.Parameters:
            try:
                if hasattr(p, "Id") and p.Id.IntegerValue == pid.IntegerValue:
                    return p
            except:
                pass
    except:
        pass
    # 3) names from sched_field (display/heading)
    if sched_field is not None:
        # schedulable field name
        nm = None
        try:
            sf = sched_field.GetSchedulableField()
            nm = sf.GetName(doc) if sf else None
        except:
            nm = None
        if nm:
            try:
                p = el.LookupParameter(nm)
                if p: return p
            except:
                pass
            gp = getattr(el, "GetParameters", None)
            if callable(gp):
                try:
                    arr = el.GetParameters(nm)
                    if arr and len(arr) > 0: return arr[0]
                except:
                    pass
        # column heading
        try:
            header_nm = sched_field.ColumnHeading
        except:
            header_nm = None
        if header_nm:
            try:
                p = el.LookupParameter(header_nm)
                if p: return p
            except:
                pass
            gp = getattr(el, "GetParameters", None)
            if callable(gp):
                try:
                    arr = el.GetParameters(header_nm)
                    if arr and len(arr) > 0: return arr[0]
                except:
                    pass
    return None

def new_key_element_by_inserting_row(schedule, body_sec, known_ids_set):
    # 행 1개 삽입 → 새 요소를 ID 차이로 추정
    body_sec.InsertRow(body_sec.NumberOfRows)
    doc.Regenerate()
    after = collect_key_elements(schedule)
    for e in after:
        eid = e.Id.IntegerValue
        if eid not in known_ids_set:
            return e
    return None

# ---------- Main ----------
schedule, resolved_as = resolve_viewschedule(schedule_or_name)
rows = parse_table(paste_text)

if schedule is None:
    OUT = ("에러: ViewSchedule을 찾을 수 없습니다.", None)
elif not rows or len(rows) <= start_row:
    OUT = ("에러: 데이터 행이 없습니다.", {"rows": len(rows)})
elif not schedule.Definition.IsKeySchedule:
    OUT = ("에러: Key Schedule만 지원합니다.", {"scheduleName": schedule.Name})
else:
    header_sec, body_sec = get_sections(schedule)
    defn = schedule.Definition
    vis_idx, vis_fields = visible_fields(defn)
    if not vis_fields:
        OUT = ("에러: 표시(숨김 아님) 필드가 없습니다.", None)
    else:
        # 전제: 첫 표시 필드가 Key Name
        key_field = vis_fields[0]
        key_pid   = key_field.ParameterId

        # 기존 키 요소 맵(이름 -> 요소) 및 ID 집합
        def key_name_of(e):
            p = try_get_parameter(e, key_pid, key_field)
            return p.AsString() if p else None
        existing = collect_key_elements(schedule)
        by_name  = { key_name_of(e): e for e in existing }
        idset    = set(e.Id.IntegerValue for e in existing)

        data_rows = rows[start_row:]
        updated, created, skipped = 0, 0, 0
        errors = []

        TransactionManager.Instance.EnsureInTransaction(doc)
        try:
            for r in data_rows:
                if not r: 
                    continue
                key_name = r[0] if len(r) > 0 else None
                if not key_name:
                    skipped += 1
                    continue

                target_elem = None

                if create_mode == "create":
                    # 새 행 생성 시도
                    target_elem = new_key_element_by_inserting_row(schedule, body_sec, idset)
                    if target_elem:
                        idset.add(target_elem.Id.IntegerValue)
                        # Key Name 먼저 기록
                        pkey = try_get_parameter(target_elem, key_pid, key_field)
                        ok, why = set_param(pkey, key_name)
                        if not ok:
                            # 중복 등으로 실패 → 기존 키 업데이트로 폴백
                            target_elem = by_name.get(key_name)
                            if target_elem is None:
                                errors.append(u"[{}] KeyName 설정 실패: {}".format(key_name, why))
                                skipped += 1
                                continue
                        else:
                            by_name[key_name] = target_elem
                            created += 1
                    else:
                        # 새 요소 확보 실패 → 기존 사용 시도
                        target_elem = by_name.get(key_name)
                        if target_elem is None:
                            skipped += 1
                            errors.append(u"[{}] 새 행 생성 실패".format(key_name))
                            continue

                else:  # upsert
                    target_elem = by_name.get(key_name)
                    if target_elem is None:
                        target_elem = new_key_element_by_inserting_row(schedule, body_sec, idset)
                        if target_elem:
                            idset.add(target_elem.Id.IntegerValue)
                            pkey = try_get_parameter(target_elem, key_pid, key_field)
                            ok, why = set_param(pkey, key_name)
                            if ok:
                                by_name[key_name] = target_elem
                                created += 1
                            else:
                                errors.append(u"[{}] KeyName 설정 실패: {}".format(key_name, why))
                                skipped += 1
                                continue
                        else:
                            skipped += 1
                            errors.append(u"[{}] 새 행 생성 실패".format(key_name))
                            continue

                # Key Name 이후 값들을 표시 컬럼 순서대로 기록 (계산/결합/KeyName 열은 건너뜀)
                vals = r[1:]  # KeyName 제외
                max_len = min(len(vals), len(vis_fields) - write_col_start)
                for j in range(max_len):
                    field = vis_fields[write_col_start + j]
                    if getattr(field, "IsCalculatedField", False) or getattr(field, "IsCombinedParameterField", False):
                        continue
                    if field.ParameterId == key_pid:
                        continue
                    p = try_get_parameter(target_elem, field.ParameterId, field)
                    ok, why = set_param(p, vals[j])
                    if not ok and why:
                        errors.append(u"[{}] pid={} -> {}".format(key_name, field.ParameterId.IntegerValue, why))
                updated += 1

        finally:
            doc.Regenerate()
            TransactionManager.Instance.TransactionTaskDone()

        OUT = (
            "완료 (Key Schedule: 헤더불요 · 순서대로 생성/기록 · SetCellText 미사용 · get_Parameter 미존재 환경 지원)",
            {
                "scheduleName": schedule.Name,
                "resolvedAs": resolved_as,
                "mode": create_mode,
                "rowsProcessed": len(data_rows),
                "updatedRows": updated,
                "createdKeys": created,
                "skippedRows": skipped,
                "visibleFieldCount": len(vis_fields),
                "writeColStart": write_col_start
            },
            errors
        )
# ----------------------------------------
헤더입력 = StringInput("Key Name\tFloor Finish\tH_Floor Base Material\tH_Floor Finish Remark\tH_STD_WM01\tH_STD_WM02\tH_STD_WM03\tH_STD_WM04\tH_STD_WM05\n")
기준칼럼 = IntegerSlider(0, range=0..100 step 1)
기준행 = IntegerSlider(0, range=0..100 step 1)
code_block = CodeBlock { "Ctrl+A 후 입력"; }
