# Dynamo graph [H_PAB.RT.G1]_Revit RVT Summary_[3.0.10].dyn "[H_PAB.RT.G1]_Revit RVT Summary_[3.0.9]_뜯" (Dynamo 3.3.0.6316)
# author: MK Jang
# Summary of Revit File

나만의_사진_링크를_붙여넣으세요 = StringInput("https://encrypted-tbn0.gstatic.com/images?q=tbn:ANd9GcS8DcTzTMtsaI7YOpQt52y8gLsDqWFKdfH46_TI2v5Z2A&s")  # graph input

# group: Pjt Information Extract
categories = Categories("OST_ProjectInformation")
all_elements_of_category = ElementsOfCategory(Category=categories)
firstItem = List.FirstItem(list=all_elements_of_category)
code_block = CodeBlock()
# ---------- code_block.designscript (4 lines) ----------
[
"Project Name",
"Building Name"
];
# ----------------------------------------
parameterByName = Parameter.ParameterByName(element=firstItem, name=code_block)
value = Parameter.Value(parameter=parameterByName)
parameters = Element.Parameters(element=firstItem)
hasValue = Parameter.HasValue(parameter=parameters)
filterByBoolMask = List.FilterByBoolMask(list=parameters, mask=hasValue)
name = Parameter.Name(parameter=filterByBoolMask.in)
code_block_2 = CodeBlock(i=name) { i!="Category"; }
filterByBoolMask_2 = List.FilterByBoolMask(list=filterByBoolMask.in, mask=code_block_2)
value_2 = Parameter.Value(parameter=filterByBoolMask_2.in)
code_block_3 = CodeBlock(i=value_2) { i!=""; }
filterByBoolMask_3 = List.FilterByBoolMask(list=filterByBoolMask_2.in, mask=code_block_3)
name_2 = Parameter.Name(parameter=filterByBoolMask_3.in)
value_3 = Parameter.Value(parameter=filterByBoolMask_3.in)
list_create = List.Create(item0=name_2, item1=value_3)
byKeysValues = DesignScript.Builtin.Dictionary.ByKeysValues(keys=name_2, values=value_3)
stringifyJSON = Data.StringifyJSON(values=byKeysValues)

building_name = CodeBlock(bdName=value) { bdName; }

# group: All Elements in Revit
categories_2 = Categories("OST_EdgeSlab")
all_elements_of_category_2 = ElementsOfCategory(Category=categories_2)
categories_3 = Categories("OST_Gutter")
all_elements_of_category_3 = ElementsOfCategory(Category=categories_3)
all_elementsexceptrails = Python(IN[0]=all_elements_of_category_2, IN[1]=all_elements_of_category_3)  # CPython3
# ---------- all_elementsexceptrails.python (90 lines) ----------
# Load the Python Standard and DesignScript Libraries
import sys
import clr
clr.AddReference('ProtoGeometry')
from Autodesk.DesignScript.Geometry import *

clr.AddReference('RevitAPI')
from Autodesk.Revit.DB import *
import Autodesk

clr.AddReference('RevitServices')
import RevitServices
from RevitServices.Persistence import DocumentManager
doc = DocumentManager.Instance.CurrentDBDocument

################Module For Functional Programing#########################
from functools import reduce
from itertools import chain
from itertools import groupby
from copy import deepcopy
curry = lambda f: lambda a,*args: f(a, *args) if (len(args)) else lambda *args: f(a, *args)

filter = curry(filter)
map = curry(map)
reduce = curry(reduce)

go = lambda *args: reduce(lambda a,f: f(a), args) ## 함수도 축약 가능 ##

def dictUpdate(dic1,dic2):
    dic1.update(dic2)
    return dic1
    
def dictsMerge(dics):
    res = reduce(dictUpdate, dics)
    return res
    
def dictDeleteKeys(dic, keys):
    for k in keys:
        del dic[k]
    return dic

def flat(a):
    if isinstance(a, list):
        for i in a: 
            yield from flat(i)
    else: yield a
#########################################################################

# The inputs to this node will be stored as a list in the IN variables.
dataEnteringNode = IN
slabEdges = IN[0]
roofGutters = IN[1]

def get_all_BIC():

    db = [
    Autodesk.Revit.DB.BuiltInCategory.OST_Floors,
    Autodesk.Revit.DB.BuiltInCategory.OST_Roofs,
    Autodesk.Revit.DB.BuiltInCategory.OST_Walls,
    Autodesk.Revit.DB.BuiltInCategory.OST_StructuralFoundation,
    Autodesk.Revit.DB.BuiltInCategory.OST_StructuralColumns,
    Autodesk.Revit.DB.BuiltInCategory.OST_StructuralFraming,
    Autodesk.Revit.DB.BuiltInCategory.OST_Ceilings,
    Autodesk.Revit.DB.BuiltInCategory.OST_Doors,
    Autodesk.Revit.DB.BuiltInCategory.OST_Windows,
    #Autodesk.Revit.DB.BuiltInCategory.OST_Stairs,
    #Autodesk.Revit.DB.BuiltInCategory.OST_Railings,
    ]
    return db
    
def get_allElems(doc):
    bics = get_all_BIC()
    
    def getElems(x):
        collector = FilteredElementCollector(doc)
        res = collector.OfCategory(x).WhereElementIsNotElementType().ToElements()
        return res

    def getRailElems(x):
        collector = FilteredElementCollector(doc)
        res = collector.OfCategory(x).WhereElementIsNotElementType()
        return res

    res = map(getElems, bics)
#    res = getRailElems(Autodesk.Revit.DB.BuiltInCategory.OST_RailingSystemRail)
    return res

result = list(get_allElems(doc))

OUT = [*result[:2], result[2]+roofGutters, result[3]+slabEdges, *result[4:]]
# ----------------------------------------
categories_4 = Categories("OST_Stairs")
all_elements_of_category_4 = ElementsOfCategory(Category=categories_4)
list_create_2 = List.Create(item0=all_elements_of_category_4)
categories_5 = Categories("OST_StairsRailing")
all_elements_of_category_5 = ElementsOfCategory(Category=categories_5)
list_create_3 = List.Create(item0=all_elements_of_category_5)
categories_6 = Categories("OST_GenericModel")
all_elements_of_category_6 = ElementsOfCategory(Category=categories_6)
filterNonDirectShape = Python(IN[0]=all_elements_of_category_6)  # CPython3
# ---------- filterNonDirectShape.python (39 lines) ----------
# Load the Python Standard and DesignScript Libraries
import sys
import clr
clr.AddReference('ProtoGeometry')
from Autodesk.DesignScript.Geometry import *

#################################Module For Functional Programing#############################################
from functools import reduce
curry = lambda f: lambda a,*args: f(a, *args) if (len(args)) else lambda *args: f(a, *args)

filter = curry(filter)
map = curry(map)

def _take(length, iter):
    res = []
    for a in iter:
        res.append(a)
        if len(res) == length:
            return res
        
take = curry(_take)
reduce = curry(reduce)

go = lambda *args: reduce(lambda a,f: f(a), args) ## 함수도 축약 가능 ##
##############################################################################################################

# The inputs to this node will be stored as a list in the IN variables.
dataEnteringNode = IN
allGNMs = IN[0]
# Place your code below this line

res = go\
(
    allGNMs,
    filter(lambda x: "Rooms_directShape" not in str(x)),
)

# Assign your output to the OUT variable.
OUT = res
# ----------------------------------------
list_create_4 = List.Create(item0=filterNonDirectShape)
join = List.Join(list0=all_elementsexceptrails, list1=list_create_2, list2=list_create_3, list3=list_create_4)

flatten = List.Flatten(list=join)

# group: get Used Fam Types
code_block_4 = CodeBlock(allElem=join) { allElem; }
code_block_5 = CodeBlock { "Family and Type"; }
parameterByName_2 = Parameter.ParameterByName(element=code_block_4, name=code_block_5)
value_4 = Parameter.Value(parameter=parameterByName_2)
code_block_6 = CodeBlock { "Type Name"; }
parameterByName_3 = Parameter.ParameterByName(element=value_4, name=code_block_6)
value_5 = Parameter.Value(parameter=parameterByName_3)
uniqueItems = List.UniqueItems(list=value_5@L2)
code_block_7 = CodeBlock()
# ---------- code_block_7.designscript (9 lines) ----------
[
"Floors","Roofs","Walls",
"Str.Foundations",
"Str.Columns",
"Str.Framings",
"Ceilings","Doors",
"Windows","Stairs","Railings",
"Generic Models"
];
# ----------------------------------------
sort = List.Sort(list=uniqueItems)

# group: 총 사용된 패밀리 타입 개수 계산
count = List.Count(list=uniqueItems@L2)
sum = Math.Sum(values=count)

code_block_8 = CodeBlock(json=list_create) { json; }
pjtInfo_HTML_part = Python(IN[0]=code_block_8)  # CPython3
# ---------- pjtInfo_HTML_part.python (33 lines) ----------
# Load the Python Standard and DesignScript Libraries
import sys
import clr
clr.AddReference('ProtoGeometry')
from Autodesk.DesignScript.Geometry import *

# The inputs to this node will be stored as a list in the IN variables.
dataEnteringNode = IN
data = IN[0]
rows = list(zip(*data))
# Place your code below this line
def make_tr(row):
    preStr = "<tr>"
    postStr = "</tr>"
    rowStrs = list(map(lambda x: f"<td>{x}</td>", row))
    res = "\n".join([preStr]+rowStrs+[postStr])
    return res

def make_trs(rows):
    #rowsWithoutHdr = rows[0:]
    rowsStrs = list(map(make_tr, rows))
    res = "\n".join(rowsStrs)
    return res

def make_wholeTable(rows):
    preStr = "<table>"
    postStr = "</table>"
    trs = make_trs(rows)
    res = "\n".join([preStr, trs, postStr])
    return res

# Assign your output to the OUT variable.
OUT = make_wholeTable(rows)
# ----------------------------------------
code_block_9 = CodeBlock(i=join) { i[4]; i[5]; }
util_nomWeight = Python()  # CPython3; unwired: IN[0]
# ---------- util_nomWeight.python (53 lines) ----------
import clr
clr.AddReference('RevitAPI')
from Autodesk.Revit.DB import *


def findNomWeight(element):
    """
    철골 부재의 Nominal Weight (kgf/m)를 계산하는 함수.
    단위 변환 상수와 밀도(7850 kg/m³)는 함수 내부에 포함됨.

    Parameters:
        element (Element): Revit Structural Framing 요소

    Returns:
        float or None: Nominal Weight (kgf/m), 계산 불가 시 None
    """
    element = UnwrapElement(element)
    try:
        # ─── 상수 정의 ───────────────────────
        FT_TO_M = 0.3048           # feet → meter
        FT3_TO_M3 = 0.0283168      # cubic feet → cubic meter
        STEEL_DENSITY = 7850       # kg/m³ (고정된 철골 밀도)

        # ─── 파라미터 가져오기 ───────────────
        volume_param = element.LookupParameter("Volume")
        if element.Category.Id.IntegerValue == int(BuiltInCategory.OST_StructuralColumns):
            length_param = element.LookupParameter("Length")
        else:
            length_param = element.LookupParameter("Cut Length")
        
        if not (volume_param and length_param):
            return None
        if not (volume_param.HasValue and length_param.HasValue):
            return None

        # ─── 단위 변환 ───────────────────────
        volume_m3 = volume_param.AsDouble() * FT3_TO_M3
        length_m = length_param.AsDouble() * FT_TO_M

        if length_m == 0:
            return None

        # ─── Nominal Weight 계산 (kgf/m) ──────
        nominal_weight = (STEEL_DENSITY * volume_m3) / length_m
        return round(nominal_weight, 2)

    except:
        return None


OUT = [
    findNomWeight,
    ]
# ----------------------------------------

# group: 기둥 종류별 구분
code_block_10 = CodeBlock()
# ---------- code_block_10.designscript (9 lines) ----------
["RC",
"Steel",
"_SC_AR S01_",
"Etc"];

["RC Column",
"Steel Column",
"Steel Column",
"Etc Column"];
# ----------------------------------------
str_column_그루핑 = Python(IN[0]=code_block_9.out0, IN[1]=code_block_10.out0, IN[2]=code_block_10.out1, IN[3]=util_nomWeight)  # CPython3
# ---------- str_column_그루핑.python (153 lines) ----------
# Load the Python Standard and DesignScript Libraries
import sys
import clr
clr.AddReference('ProtoGeometry')
from Autodesk.DesignScript.Geometry import *

clr.AddReference('RevitNodes')
import Revit
clr.ImportExtensions(Revit.Elements)
from Revit import Elements

################Module For Functional Programing#########################
from functools import reduce
from itertools import chain
from itertools import groupby
from copy import deepcopy
curry = lambda f: lambda a,*args: f(a, *args) if (len(args)) else lambda *args: f(a, *args)

filter = curry(filter)
map = curry(map)
reduce = curry(reduce)

go = lambda *args: reduce(lambda a,f: f(a), args) ## 함수도 축약 가능 ##

def dictUpdate(dic1,dic2):
    dic1.update(dic2)
    return dic1
    
def dictsMerge(dics):
    res = reduce(dictUpdate, dics)
    return res
    
def dictDeleteKeys(dic, keys):
    for k in keys:
        del dic[k]
    return dic

def flat(a):
    if isinstance(a, list):
        for i in a: 
            yield from flat(i)
    else: yield a
#########################################################################
# The inputs to this node will be stored as a list in the IN variables.
dataEnteringNode = IN
allFrames = IN[0]
#propNamesDict = IN[1]
#propCodes = list(propNamesDict.keys())
#propNames = list(propNamesDict.values())
propCodes = IN[1]
propNames = IN[2]
[findNomWeight] = IN[3]
# Place your code below this line

def findTypeName(e):
    res = e\
        .GetParameterValueByName("Family and Type")\
        .GetParameterValueByName("Type Name")
    return res
    
def findTypeWeight(e):
    nomWeight = findNomWeight(e)
    if nomWeight >= 90:
        res = "Heavy"
    elif nomWeight < 30:
        res = "Light"
    else:
        res = "Medium"
    return res

def groupByProperties(elems, propCodes, propNames):
    print(propCodes)
    cnt = range(len(propCodes))
    def normalize(s):
        return str(s).replace("_", "").replace(" ", "").lower()
    
    findGroup = lambda nth: go(
        elems,
        filter(
            lambda elem: normalize(propCodes[nth]) in normalize(elem.GetParameterValueByName("Family and Type") or "")
        ),
        list,
    )
    
    grpPerKind = list(map(lambda nth: list(findGroup(nth)), cnt))
    grpEtc = [x for x in elems if x not in list(chain(*grpPerKind))]
    #print(f"grpEtc: {grpEtc}")
    # 모든 포함된 요소들을 ID 기준으로 수집
    #included_ids = set(e.Id for g in grpPerKind for e in g)
    # Etc 그룹 만들기 (ID 기준으로 비교)
    #grpEtc = [x for x in elems if x.Id not in included_ids]
    grpPerKind[-1] = grpEtc
    
    def findRC_colTypes(grp):
        res = go(
            grp,
            map(findTypeName),
            set, sorted, list,
        )
        return res
    
    def findSteel_colTypes(grp):
        pretag = "<strong style='font-size:100%'>"
        posttag = "</strong>"
        res = {}
        subGrpNames = ["Heavy", "Medium", "Light"]
        for n in subGrpNames:
            subs = go(
                grp,
                filter(lambda e: findTypeWeight(e) == n),
                map(findTypeName),
                set, sorted, list,
            )
            res[pretag +"!! " + n +" !!" + posttag] = ["", subs, ""]
            print(subs)
        return res
    
    # RC, etc면 그냥 , Steel 이면 heavy, mediun, light 소그룹 형성
    res = {}
    for i in cnt:
        print(cnt)
        codeName = propNames[i]
        print(codeName)
        discName = propCodes[i]
        grp = grpPerKind[i]
        if "RC" in codeName or "Etc" in codeName:
            res[codeName] = findRC_colTypes(grp)
        else:
            res[codeName] = findSteel_colTypes(grp)
    #print(res)
    return res

grpsDict = groupByProperties(allFrames, propCodes, propNames)
#print(grpsDict)



def cvtIntoHTML(grpsDict):
    pre_strongTag = "<strong style='font-size:120%'> [ "
    post_strongTag = " ] </strong>"
    res = []
    for k,v in grpsDict.items():
        if isinstance(v,list):
            res.append([pre_strongTag+ k +post_strongTag, "-"*20,*v,"="*50," "*10])
        elif isinstance(v,dict):
            res.append([pre_strongTag+ k +post_strongTag, "-"*20, list(chain(*v.items())),"="*50," "*10])
        
    return res



# Assign your output to the OUT variable.
OUT = cvtIntoHTML(grpsDict)
# ----------------------------------------
flatten_2 = List.Flatten(list=str_column_그루핑)

# group: 프레임 종류별 구분
code_block_11 = CodeBlock()
# ---------- code_block_11.designscript (19 lines) ----------
//propCodes
["S16",
"S02",
"_SB_AR S01",
"S03",
"S04",
"B03",
"B04",
"Etc"];

//propNames
["RC Beam",
"Steel Beam",
"Steel Beam (코드오기 확인요망. Beam은 S02)",
"HBrace",
"VBrace",
"Purlin",
"Girth",
"Etc Framing"];
# ----------------------------------------
str_framing_그루핑 = Python(IN[0]=code_block_9.out1, IN[1]=code_block_11.out0, IN[2]=code_block_11.out1, IN[3]=util_nomWeight)  # CPython3
# ---------- str_framing_그루핑.python (150 lines) ----------
# Load the Python Standard and DesignScript Libraries
import sys
import clr
clr.AddReference('ProtoGeometry')
from Autodesk.DesignScript.Geometry import *

clr.AddReference('RevitNodes')
import Revit
clr.ImportExtensions(Revit.Elements)
from Revit import Elements

################Module For Functional Programing#########################
from functools import reduce
from itertools import chain
from itertools import groupby
from copy import deepcopy
curry = lambda f: lambda a,*args: f(a, *args) if (len(args)) else lambda *args: f(a, *args)

filter = curry(filter)
map = curry(map)
reduce = curry(reduce)

go = lambda *args: reduce(lambda a,f: f(a), args) ## 함수도 축약 가능 ##

def dictUpdate(dic1,dic2):
    dic1.update(dic2)
    return dic1
    
def dictsMerge(dics):
    res = reduce(dictUpdate, dics)
    return res
    
def dictDeleteKeys(dic, keys):
    for k in keys:
        del dic[k]
    return dic

def flat(a):
    if isinstance(a, list):
        for i in a: 
            yield from flat(i)
    else: yield a
#########################################################################
# The inputs to this node will be stored as a list in the IN variables.
dataEnteringNode = IN
allFrames = IN[0]
#propNamesDict = IN[1]
#propCodes = list(propNamesDict.keys())
#propNames = list(propNamesDict.values())
propCodes = IN[1]
propNames = IN[2]
[findNomWeight] = IN[3]
# Place your code below this line

def findTypeName(e):
    res = e\
        .GetParameterValueByName("Family and Type")\
        .GetParameterValueByName("Type Name")
    return res
    
def findTypeWeight(e):
    nomWeight = findNomWeight(e)
    if nomWeight:
        if nomWeight >= 90:
            res = "Heavy"
        elif nomWeight < 30:
            res = "Light"
        else:
            res = "Medium"
    else:
        res = "Etc"
    return res

def groupByProperties(elems, propCodes, propNames):
    cnt = range(len(propCodes))
    #keys = propCodes[:-1]
    #etc = 
    findGroup = lambda nth: go(
        elems,
        filter(lambda elem: propCodes[nth] in str(elem.GetParameterValueByName("Family and Type"))),
        list,
    )
    
    # grpPerKind -> revit elements / by group  / list
    grpPerKind = list(map(lambda nth: list(findGroup(nth)), cnt))
    # grpEtc = [x for x in elems if x not in list(chain(*grpPerKind))]
    # 모든 포함된 요소들을 ID 기준으로 수집
    included_ids = set(e.Id for g in grpPerKind for e in g)
    # Etc 그룹 만들기 (ID 기준으로 비교)
    grpEtc = [x for x in elems if x.Id not in included_ids]
    grpPerKind[-1] = grpEtc
    
    
    def findRC_colTypes(grp):
        res = go(
            grp,
            map(findTypeName),
            set, sorted, list,
        )
        return res
    
    def findSteel_colTypes(grp):
        pretag = "<strong style='font-size:100%'>"
        posttag = "</strong>"
        res = {}
        subGrpNames = ["Heavy", "Medium", "Light", "Etc"]
        for n in subGrpNames:
            subs = go(
                grp,
                filter(lambda e: findTypeWeight(e) == n),
                map(findTypeName),
                set, sorted, list,
            )
            res[pretag +"!! " + n +" !!" + posttag] = ["", subs, ""]
        return res
    
    # RC, etc면 그냥 , Steel 이면 heavy, mediun, light 소그룹 형성
    res = {}
    for i in cnt:
        discName = propCodes[i]
        codeName = propNames[i]
        
        grp = grpPerKind[i]
        if "RC" in codeName or "Etc" in codeName:
            res[codeName] = findRC_colTypes(grp)
        else:
            res[codeName] = findSteel_colTypes(grp)

    return res

grpsDict = groupByProperties(allFrames, propCodes, propNames)



def cvtIntoHTML(grpsDict):
    pre_strongTag = "<strong style='font-size:120%'> [ "
    post_strongTag = " ] </strong>"
    res = []
    for k,v in grpsDict.items():
        if isinstance(v,list):
            res.append([pre_strongTag+ k +post_strongTag, "-"*20,*v,"="*50," "*10])
        elif isinstance(v,dict):
            res.append([pre_strongTag+ k +post_strongTag, "-"*20, list(chain(*v.items())),"="*50," "*10])
        
    return res



# Assign your output to the OUT variable.
OUT = cvtIntoHTML(grpsDict)
# ----------------------------------------
flatten_3 = List.Flatten(list=str_framing_그루핑)
code_block_12 = CodeBlock()
# ---------- code_block_12.designscript (8 lines) ----------
{
"S16": "RC Beam",
"S02": "Steel Beam",
"S03": "HBrace",
"S04": "VBrace",
"B03": "Purlin",
"B04": "Girth"
};
# ----------------------------------------

# group: Steel 부재 목록 서브 그룹화 된 리스트로 치환
code_block_13 = CodeBlock { 4; }
replaceItemAtIndex = List.ReplaceItemAtIndex(list=sort, index=code_block_13, item=flatten_2)
code_block_14 = CodeBlock { 5; }
replaceItemAtIndex_2 = List.ReplaceItemAtIndex(list=replaceItemAtIndex, index=code_block_14, item=flatten_3)

# group (continued): get Used Fam Types
addItemToFront = List.AddItemToFront(item=code_block_7, list=replaceItemAtIndex_2, lacing=Shortest)
famType_HTML_part = Python(IN[0]=addItemToFront)  # CPython3
# ---------- famType_HTML_part.python (64 lines) ----------
# Load the Python Standard and DesignScript Libraries
import sys
import clr
clr.AddReference('ProtoGeometry')
from Autodesk.DesignScript.Geometry import *

clr.AddReference('RevitNodes')
import Revit
clr.ImportExtensions(Revit.Elements)
from Revit import Elements

from itertools import chain
#################################Module For Functional Programing#############################################
from functools import reduce
curry = lambda f: lambda a,*args: f(a, *args) if (len(args)) else lambda *args: f(a, *args)

filter = curry(filter)
map = curry(map)
reduce = curry(reduce)

go = lambda *args: reduce(lambda a,f: f(a), args) ## 함수도 축약 가능 ##
##############################################################################################################
# The inputs to this node will be stored as a list in the IN variables.
dataEnteringNode = IN
grps = IN[0]
# Place your code below this line
def make_tr(row):
    preStr = "<tr>"
    postStr = "</tr>"
    rowStrs = list(map(lambda x: f"<td>{x}</td>", row))
    res = "\n".join([preStr]+rowStrs+[postStr])
    return res

def make_trs(rows):
    #rowsWithoutHdr = rows[0:]
    rowsStrs = list(map(make_tr, rows))
    res = "\n".join(rowsStrs)
    return res

def make_wholeTable(rows):
    preStr = "<table>"
    postStr = "</table>"
    trs = make_trs(rows)
    res = "\n".join([preStr, trs, postStr])
    return res

def transTo_tableForm(grp):
    chkbox_tagStr = '<input type="checkbox" id="chkbox" name="checks">'
    res_ = go\
    (
        grp,
        map(lambda x: [x, "", chkbox_tagStr]),
    )
    title = "<h2>"+grp.pop(0)+"</h2>"
    res = [[title,""]]
    for i in grp:
        res.append([i,chkbox_tagStr])
    
    return res
rows = list(chain(*map(transTo_tableForm, grps)))


# Assign your output to the OUT variable.
OUT = make_wholeTable(rows)
# ----------------------------------------

# group: get Room Datas
rooms_by_status = RoomsByStatus()
code_block_15 = CodeBlock(i=rooms_by_status.PlacedRooms) { i; }
code_block_16 = CodeBlock()
# ---------- code_block_16.designscript (10 lines) ----------
[
"Number",
"Name",
"Level",
"Area",
"Floor Finish",
"Base Finish",
"Wall Finish",
"Ceiling Finish"
];
# ----------------------------------------
parameterByName_4 = Parameter.ParameterByName(element=code_block_15@L1, name=code_block_16)
code_block_17 = CodeBlock { 0; }
getItemAtIndex = List.GetItemAtIndex(list=parameterByName_4@@L2, index=code_block_17)
value_6 = Parameter.Value(parameter=getItemAtIndex)
sortByKey = List.SortByKey(list=parameterByName_4, keys=value_6)
set_room_datas = Python(IN[0]=sortByKey.sortedList)  # CPython3
# ---------- set_room_datas.python (59 lines) ----------
# Load the Python Standard and DesignScript Libraries
import sys
import clr
clr.AddReference('ProtoGeometry')
from Autodesk.DesignScript.Geometry import *

################Module For Functional Programing##########################
from functools import reduce
from itertools import chain
from itertools import groupby
from copy import deepcopy
curry = lambda f: lambda a,*args: f(a, *args) if (len(args)) else lambda *args: f(a, *args)

filter = curry(filter)
map = curry(map)
reduce = curry(reduce)

go = lambda *args: reduce(lambda a,f: f(a), args) ## 함수도 축약 가능 ##

def dictUpdate(dic1,dic2):
    res = dic1.update(dic2)
    #res = {**dic1,**dic2}
    return dic1 #res
    
def dictsMerge(dics):
    res = reduce(dictUpdate, dics)
    return res
    
def dictDeleteKeys(dic, keys):
    for k in keys:
        del dic[k]
    return dic
##########################################################################

# The inputs to this node will be stored as a list in the IN variables.
dataEnteringNode = IN
roomDatas = IN[0]

# Place your code below this line

def setRoomDataPair(roomData):
    keys = list(map(lambda x: x.Name, roomData))
    vals_src = list(map(lambda x: x.Value, roomData))
    preVals = \
    go(
        vals_src[:4],
        lambda x: [x[0], x[1], x[2], round(x[3],2)]
    )
    
    postVals = [x if isinstance(x,str) or x==None
                else x.GetParameterValueByName("Key Name")
                for x in vals_src[4:]]

    vals = preVals + postVals
    
    return keys, vals
#keys = list(map(lambda x: x.Name, roomDatas[0]))
# Assign your output to the OUT variable.
OUT = map(setRoomDataPair, roomDatas)
# ----------------------------------------
code_block_18 = CodeBlock(i=set_room_datas) { i[0][0]; }
code_block_19 = CodeBlock { 1; }
getItemAtIndex_2 = List.GetItemAtIndex(list=set_room_datas@@L3, index=code_block_19)
code_block_20 = CodeBlock { " / "; }
code_block_21 = CodeBlock()
# ---------- code_block_21.designscript (6 lines) ----------
[
"Floor Finish Style No",
"Skirt Finish Style No",
"Wall Finish Style No",
"Ceiling Finish Style No"
];
# ----------------------------------------
parameterByName_5 = Parameter.ParameterByName(element=code_block_15@L1, name=code_block_21)
value_7 = Parameter.Value(parameter=parameterByName_5)
code_block_22 = CodeBlock { "Key Name"; }
getKeyName_room = Python(IN[0]=value_7, IN[1]=code_block_22)  # CPython3
# ---------- getKeyName_room.python (56 lines) ----------
# Load the Python Standard and DesignScript Libraries
import sys
import clr
clr.AddReference('ProtoGeometry')
from Autodesk.DesignScript.Geometry import *

################Module For Functional Programing#########################
from functools import reduce
from itertools import chain
from itertools import groupby
from copy import deepcopy
curry = lambda f: lambda a,*args: f(a, *args) if (len(args)) else lambda *args: f(a, *args)

filter = curry(filter)
map = curry(map)
reduce = curry(reduce)

go = lambda *args: reduce(lambda a,f: f(a), args) ## 함수도 축약 가능 ##

def dictUpdate(dic1,dic2):
    dic1.update(dic2)
    return dic1
    
def dictsMerge(dics):
    res = reduce(dictUpdate, dics)
    return res
    
def dictDeleteKeys(dic, keys):
    for k in keys:
        del dic[k]
    return dic

def flat(a):
    if isinstance(a, list):
        for i in a: 
            yield from flat(i)
    else: yield a
#########################################################################

# The inputs to this node will be stored as a list in the IN variables.
dataEnteringNode = IN
fin_schedule_params = IN[0]
targetName = IN[1]

# Place your code below this line

def get_styleName(e,targetName):
    try:
        res = e.GetParameterValueByName(targetName)
    except:
        res = ""
    return res

# Assign your output to the OUT variable.
OUT = map(lambda grp: \
        map(lambda x: get_styleName(x,targetName), grp), fin_schedule_params)
# ----------------------------------------
join_2 = String.Join(separator=code_block_20, string0=getKeyName_room)
code_block_23 = CodeBlock(i=join_2) { i[0]; }
sortByKey_2 = List.SortByKey(list=code_block_23, keys=value_6)
groupByKey = List.GroupByKey(list=getItemAtIndex_2, keys=sortByKey_2.sortedList)
code_block_24 = CodeBlock { [" "," "," "," "," "," "," "]; }
addItemToFront_2 = List.AddItemToFront(item=groupByKey.uniqueKeys@L1, list=code_block_24)
code_block_25 = CodeBlock(i=groupByKey.groups) { i; }
addItemToFront_3 = List.AddItemToFront(item=addItemToFront_2@L2, list=code_block_25@@L3)
flatten_4 = List.Flatten(list=addItemToFront_3@L2)
old = CodeBlock()
# ---------- old.designscript (10 lines) ----------
[
"Number",
"Name",
"Level",
"Area",
"H_Floor Finish Style Name",
"H_Skirt Finish Style Name",
"H_Wall Finish Style Name",
"H_Ceiling Finish Style Name"
];
# ----------------------------------------

code_block_26 = CodeBlock { [0,1]; }
getItemAtIndex_3 = List.GetItemAtIndex(list=code_block_18, index=code_block_26)
getItemAtIndex_4 = List.GetItemAtIndex(list=addItemToFront_3@L2, index=code_block_26)
roomInfoPart_NumberName = Python(IN[0]=getItemAtIndex_3, IN[1]=getItemAtIndex_4)  # CPython3
# ---------- roomInfoPart_NumberName.python (50 lines) ----------
# Load the Python Standard and DesignScript Libraries
import sys
import clr
clr.AddReference('ProtoGeometry')
from Autodesk.DesignScript.Geometry import *

# The inputs to this node will be stored as a list in the IN variables.
dataEnteringNode = IN
hdr = IN[0]
rows = IN[1]

#hdr = rows[0][0]
# Place your code below this line
def make_th(hdr):
    preStr = "<tr>"
    postStr = "</tr>"
    hdrStrs = list(map(lambda x: f"<th>{x}</th>", hdr))
    hdrStrs.insert(2,"<th>CheckBox</th>")
    res = "\n".join([preStr]+hdrStrs+[postStr])
    return res

def make_tr(row):
    preStr = "<tr>"
    postStr = "</tr>"
    rowStrs = []

    if " / B" in str(row):
        for r in row:
            rowStrs.append(f"<td><h4>{r}</h4></td>")
    else:
        for r in row:
            rowStrs.append(f"<td>{r}</td>")
    rowStrs.insert(2,'<td><input type="checkbox" id="rmChkbox" name="rmCheks"></td>')
    #rowStrs = list(map(lambda x: f"<td>{x}</td>", row))
    res = "\n".join([preStr]+rowStrs+[postStr])
    return res

def make_trs(rows):
    rowsWithoutHdr = rows[0:]
    rowsStrs = list(map(make_tr, rowsWithoutHdr))
    res = "\n".join(rowsStrs)
    return res

def make_wholeTable(th,trs):
    preStr = "<table>"
    postStr = "</table>"
    res = "\n".join([preStr, th, trs, postStr])
    return res
# Assign your output to the OUT variable.
OUT = make_wholeTable(make_th(hdr), make_trs(rows))
# ----------------------------------------
code_block_27 = CodeBlock(roomPart=roomInfoPart_NumberName) { roomPart; }
roomInfoPart = Python(IN[0]=code_block_18, IN[1]=flatten_4)  # CPython3
# ---------- roomInfoPart.python (54 lines) ----------
# Load the Python Standard and DesignScript Libraries
import sys
import clr
clr.AddReference('ProtoGeometry')
from Autodesk.DesignScript.Geometry import *

# The inputs to this node will be stored as a list in the IN variables.
dataEnteringNode = IN
hdr = IN[0]
rows = IN[1]

#hdr = rows[0][0]
# Place your code below this line
def make_th(hdr):
    preStr = "<tr>"
    postStr = "</tr>"
    hdrStrs = list(map(lambda x: f"<th>{x}</th>", hdr))
    #hdrStrs.insert(2,"<th>CheckBox</th>")
    res = "\n".join([preStr]+hdrStrs+[postStr])
    return res

def make_tr(row):
    preStr = "<tr>"
    postStr = "</tr>"
    rowStrs = []

    if " / B" in str(row):
        for r in row:
            rowStrs.append(f"<td><h5>{r}</h5></td>")
    else:
        for r in row:
            rowStrs.append(f"<td>{r}</td>")
    #rowStrs.insert(2,'<td><input type="checkbox" id="rmChkbox" name="rmCheks"></td>')
    #rowStrs = list(map(lambda x: f"<td>{x}</td>", row))
    res = "\n".join([preStr]+rowStrs+[postStr])
    return res

def make_trs(rows):
    rowsWithoutHdr = rows[0:]
    rowsStrs = list(map(make_tr, rowsWithoutHdr))
    res = "\n".join(rowsStrs)
    return res

def make_wholeTable(th,trs):
    try:
        preStr = "<table>"
        postStr = "</table>"
        res = "\n".join([preStr, th, trs, postStr])
    except:
        res = ""
    
    return res
# Assign your output to the OUT variable.
OUT = make_wholeTable(make_th(hdr), make_trs(rows))
# ----------------------------------------
code_block_28 = CodeBlock(roomPart_2=roomInfoPart) { roomPart_2; }

# group: HTML Export
javascriptPart = Python(IN[0]=나만의_사진_링크를_붙여넣으세요)  # CPython3; unwired: IN[1], IN[2]
# ---------- javascriptPart.python (66 lines) ----------
# Load the Python Standard and DesignScript Libraries
import sys
import clr
clr.AddReference('ProtoGeometry')
from Autodesk.DesignScript.Geometry import *

# The inputs to this node will be stored as a list in the IN variables.
dataEnteringNode = IN
catImgLink = '"' + IN[0] + '"'

# Place your code below this line
jsPart = '''

function hideAllPages() {
        document.querySelector("#home").style.fontWeight = "normal";
        document.querySelector("#homePage").style.display = "None";
        document.querySelector("#info").style.fontWeight = "normal";
        document.querySelector("#infoPage").style.display = "None";
        document.querySelector("#famType").style.fontWeight = "normal";
        document.querySelector("#famTypePage").style.display = "None";
        document.querySelector("#roomInfo").style.fontWeight = "normal";
        document.querySelector("#roomInfoPage").style.display = "None";
        document.querySelector("#roomInfoPage_chk").style.display = "None";
}

document.querySelector("#cute").onclick = function() {
	    let img = document.createElement("img");
	    
	    img.setAttribute("src", %s);
	    document.querySelector("#cute").style.display = "None";
	    img.setAttribute("style", "width:500px;margin-top:20px;");
	    
	    //document.body.append(img);
	    const place = document.querySelector("#mainImg");
	    place.append(img);
	    
	};
document.querySelector("#home").onclick = function() {
        hideAllPages();
        document.querySelector("#home").style.fontWeight = "bolder";
        document.querySelector("#homePage").style.display = "inline";
	};
document.querySelector("#info").onclick = function() {
        hideAllPages();
        document.querySelector("#info").style.fontWeight = "bolder";
        document.querySelector("#infoPage").style.display = "inline";
	};
document.querySelector("#famType").onclick = function() {
        hideAllPages();
        document.querySelector("#famType").style.fontWeight = "bolder";
        document.querySelector("#famTypePage").style.display = "inline";
	};
document.querySelector("#roomInfo").onclick = function() {
        hideAllPages();
        document.querySelector("#roomInfo").style.fontWeight = "bolder";
        document.querySelector("#roomInfoPage").style.display = "inline";
	};
document.querySelector("#roomInfo_chk").onclick = function() {
        hideAllPages();
        document.querySelector("#roomInfo_chk").style.fontWeight = "bolder";
        document.querySelector("#roomInfoPage_chk").style.display = "inline";
	};
	
''' %catImgLink
# Assign your output to the OUT variable.
OUT = jsPart
# ----------------------------------------
cssPart = Python()  # CPython3; unwired: IN[0], IN[1], IN[2]
# ---------- cssPart.python (125 lines) ----------
# Load the Python Standard and DesignScript Libraries
import sys
import clr
clr.AddReference('ProtoGeometry')
from Autodesk.DesignScript.Geometry import *

# The inputs to this node will be stored as a list in the IN variables.
dataEnteringNode = IN

# Place your code below this line
cssPart = '''

/* style.css */
img {
 width : 25%;
 height: 25%; 
}

:root {
  --text-color: #f0f4f5;
  --background-color: #263343;
  --accent-color: orange;
  --icons-color: rgb(152, 187, 201);
  --bodybackground-color: lightgray;
}

th {
  text-align: center;
  padding-left: 30px;
}

td {
  padding-left: 40px;
  border-bottom : 1px solid gray;
  border-collapse : collapse;
}

body {
  margin: 0;
  background-color: var(--bodybackground-color);
  font-family: 'STIX Two Math';
} 

a {
  text-decoration: none;
  color: var(--text-color);
}

.navbar {
  display: flex;
  position: sticky;
  top: 0px; /* 도달했을때 고정시킬 위치 */
  justify-content: space-between;
  align-items: center;
  background-color: var(--background-color);
  padding: 8px 12px;
  font-family: 'STIX Two Math';
}

.navbar__logo i {
  color: var(--accent-color);
  padding-left: 0;
}

.navbar__menu {
  list-style: none;
  display: flex;
  margin: 0;
  padding-left: 0;
}

.navbar__menu li {
  padding: 8px 30px;
  color: var(--text-color);
}

.navbar__menu li:hover {
  background-color: var(--accent-color);
  border-radius: 3px;
}

.navbar__icons {
  list-style: none;
  display: flex;
  color: var(--icons-color);
  margin: 0;
  padding-left: 0;
}

.navbar__icons li {
  padding: 8px 12px;
  margin: 0;
}

#cute {
  display: block;
  }

#home {
  font-weight: bolder;
  }

#homePage {
  display: inline;
  }

#infoPage {
  display: None;
  }

#famTypePage {
  display: None;
  }

#roomInfoPage {
  display: None;
  }

#roomInfoPage_chk {
  display: None;
  }

'''
# Assign your output to the OUT variable.
OUT = cssPart
# ----------------------------------------
navHTML_Part = Python()  # CPython3; unwired: IN[0]
# ---------- navHTML_Part.python (28 lines) ----------
# Load the Python Standard and DesignScript Libraries
import sys
import clr
clr.AddReference('ProtoGeometry')
from Autodesk.DesignScript.Geometry import *

# The inputs to this node will be stored as a list in the IN variables.
dataEnteringNode = IN

# Place your code below this line
navPart = f'''

<nav class="navbar">

  <ul class="navbar__menu">
    <li id="home">Home</li>
    <li id="info">Project Information</li>
    <li id="famType">Used Family Types</li>
    <li id="roomInfo">Room Information_입력용</li>
    <li id="roomInfo_chk">Room Information_검토용</li>
  </ul>

</nav>

'''

# Assign your output to the OUT variable.
OUT = navPart
# ----------------------------------------
serverFilePath = CodeBlock { ".dynTempServer"; }
set_port_number_기본값_8100_작동_오류 = StringInput("8100")  # "Set Port Number: 기본값-8100 (작동 오류 없다면 변경 금지)"
htmlPath = Python(IN[0]=serverFilePath)  # CPython3
# ---------- htmlPath.python (34 lines) ----------
# Load the Python Standard and DesignScript Libraries
import sys
import clr
clr.AddReference('ProtoGeometry')
from Autodesk.DesignScript.Geometry import *
import time
import subprocess
import os

clr.AddReference('RevitNodes')
import Revit
clr.ImportExtensions(Revit.Elements)
from Revit import Elements
# The inputs to this node will be stored as a list in the IN variables.
dataEnteringNode = IN
dynTempServerPath = IN[0]
# Place your code below this line
def find_cwd():
    doc = Revit.Application.Document.Current
    filePath_string = doc.FilePath
    folderPath = filePath_string.split('\\')
    folderPath.pop(-1)
    folderPath_str = '\\'.join(folderPath)
    return folderPath_str

#cwd = find_cwd()
cwd = os.getenv("HomePath")

folderPath = f"{cwd}\\{dynTempServerPath}"
if not os.path.exists(folderPath):
    os.makedirs(folderPath)

# Assign your output to the OUT variable.
OUT = "C:"+folderPath
# ----------------------------------------
make_htmlStr = Python(IN[0]=javascriptPart, IN[1]=cssPart)  # CPython3; unwired: IN[2]
# ---------- make_htmlStr.python (53 lines) ----------
# Load the Python Standard and DesignScript Libraries
import sys
import clr
clr.AddReference('ProtoGeometry')
from Autodesk.DesignScript.Geometry import *

# The inputs to this node will be stored as a list in the IN variables.
dataEnteringNode = IN
jsPart = IN[0]
cssPart = IN[1]
tablePart = IN[2]

# Place your code below this line
##folderPath_r = folderPath.replace('\\','\\\\')

htmlStr = f'''
<!DOCTYPE html>
<html lang="ko">

<head>
    <meta charset="UTF-8">
    <title>my first three.js app</title>
    <style>
        {cssPart}
    </style>
</head>

<body>


<div class="wrapper">

  <a data-fslightbox="gallery" href="#custom-source">
    유튜브 라이트박스
  </a>

  <iframe id="custom-source"
          frameborder="0"
          width="1920px"
          height="1080px"
          allow="autoplay; fullscreen"
          src="https://www.youtube.com/embed/qgBSiRwsbNw?autoplay=1">
  </iframe>
</div>

<script src="https://cdnjs.cloudflare.com/ajax/libs/fslightbox/3.3.1/index.min.js" integrity="sha512-EqNNJuepkw5P9vxCml8eBk7C4Ld+4kAnvzOD/jG21rkxWPILGoQa5EvD62UieiJF0u3xoQrcVnce4i83VnYj/Q==" crossorigin="anonymous" referrerpolicy="no-referrer"></script>

</body>

</html>
'''
# Assign your output to the OUT variable.
OUT = htmlStr
# ----------------------------------------

htmlPath_new = Python(IN[0]=serverFilePath)  # CPython3
# ---------- htmlPath_new.python (35 lines) ----------
# Load the Python Standard and DesignScript Libraries
import sys
import clr
clr.AddReference('ProtoGeometry')
from Autodesk.DesignScript.Geometry import *
import time
import subprocess
import os

clr.AddReference('RevitNodes')
import Revit
clr.ImportExtensions(Revit.Elements)
from Revit import Elements
# The inputs to this node will be stored as a list in the IN variables.
dataEnteringNode = IN
dynTempServerPath = IN[0]
# Place your code below this line
def find_cwd():
    doc = Revit.Application.Document.Current
    filePath_string = doc.FilePath
    folderPath = filePath_string.split('\\')
    folderPath.pop(-1)
    folderPath_str = '\\'.join(folderPath)
    return folderPath_str

#cwd = find_cwd()
cwd = os.getenv("HomePath")

folderPath = f"{cwd}\\{dynTempServerPath}"
if not os.path.exists(folderPath):
    os.makedirs(folderPath)

# Assign your output to the OUT variable.
#OUT = find_cwd() + "\\.dynTemp\\tmpForSummary"
OUT = "D:\\\\.Temp_forDyn"
# ----------------------------------------
homePageHTML_Part = Python(IN[0]=flatten, IN[1]=sum, IN[2]=htmlPath_new)  # CPython3
# ---------- homePageHTML_Part.python (33 lines) ----------
# Load the Python Standard and DesignScript Libraries
import sys
import clr
clr.AddReference('ProtoGeometry')
from Autodesk.DesignScript.Geometry import *

# The inputs to this node will be stored as a list in the IN variables.
dataEnteringNode = IN
allElems = IN[0]
cntElems = len(allElems)
cntTypes = int(IN[1])
tmp_path = IN[2]
# Place your code below this line
homePart = f'''
<div>
    <br>
    <h3>이 레빗 프로젝트 파일은 현재.. </h3>
    <h1>
        총, [ {cntElems} ] 개의 부재 들과,<br>
        &nbsp;&nbsp;&nbsp;&nbsp;&nbsp;&nbsp;&nbsp;
        [ {cntTypes} ] 개의 타입 들로 
    </h1>
    <h3>작성되어 있습니다... </h3>
    <br><br>
    <p>패밀리 타입을 검토하시려면<br>상단 메뉴의 <b>Used Family Types</b> 탭을 클릭하세요.</p>
    <div id="mainImg">
        <img src="{tmp_path}//3d.jpg" alt="3d">
    </div>
</div>
'''

# Assign your output to the OUT variable.
OUT = homePart
# ----------------------------------------

# group (continued): HTML Export
list_create_5 = List.Create(item0=homePageHTML_Part, item1=pjtInfo_HTML_part, item2=famType_HTML_part, item3=code_block_27, item4=code_block_28)
make_htmlStr_2 = Python(IN[0]=javascriptPart, IN[1]=cssPart, IN[2]=navHTML_Part, IN[3]=building_name, IN[4]=list_create_5)  # CPython3
# ---------- make_htmlStr_2.python (79 lines) ----------
# Load the Python Standard and DesignScript Libraries
import sys
import clr
clr.AddReference('ProtoGeometry')
from Autodesk.DesignScript.Geometry import *

# The inputs to this node will be stored as a list in the IN variables.
dataEnteringNode = IN
jsPart = IN[0]
cssPart = IN[1]
navPart = IN[2]

pjtName = IN[3][0]
bdName = IN[3][1]
pages = IN[4]

homePage = pages[0]
infoPage = pages[1]
famTypePage = pages[2]
roomInfoPage = pages[3]
roomInfoPage_forChk = pages[4]

# Place your code below this line
##folderPath_r = folderPath.replace('\\','\\\\')

htmlStr = f'''
<!DOCTYPE html>
<html lang="ko">

<head>
    <link rel="shortcut icon" href="#">
    <meta charset="UTF-8">
    <title>RVT Summary</title>
    <style>
        {cssPart}
    </style>
</head>

<header>
<h5>&nbsp;&nbsp;Revit Modeling Information Summary Page</h5>
<h3>&nbsp;&nbsp;『 {pjtName} 』 Project</h4>
<h4>&nbsp;&nbsp;{bdName}</h4>
</header>

<body>
{navPart}

<div id="homePage">
{homePage}
</div>

<div id="infoPage">
{infoPage}
</div>

<div id="famTypePage">
{famTypePage}
</div>

<div id="roomInfoPage">
{roomInfoPage}
</div>

<div id="roomInfoPage_chk">
{roomInfoPage_forChk}
</div>

<button id="cute">귀여운 무언가를 보기 버튼</button><br>

<script>
{jsPart}
</script>

</body>

</html>
'''
# Assign your output to the OUT variable.
OUT = htmlStr
# ----------------------------------------
code_block_29 = CodeBlock(htmlStr=make_htmlStr_2) { htmlStr; }
create_html_file_and_open = Python(IN[0]=code_block_29, IN[1]=htmlPath_new, IN[2]=set_port_number_기본값_8100_작동_오류)  # CPython3
# ---------- create_html_file_and_open.python (105 lines) ----------
# Load the Python Standard and DesignScript Libraries
import os
import sys
import clr
clr.AddReference('ProtoGeometry')
from Autodesk.DesignScript.Geometry import *

clr.AddReference('RevitNodes')
import Revit
clr.ImportExtensions(Revit.Elements)
from Revit import Elements

import time
import subprocess
import asyncio
import multiprocessing

#################################Module For Functional Programing#############################################
from functools import reduce
curry = lambda f: lambda a,*args: f(a, *args) if (len(args)) else lambda *args: f(a, *args)

filter = curry(filter)
map = curry(map)

def _take(length, iter):
    res = []
    for a in iter:
        res.append(a)
        if len(res) == length:
            return res
        
take = curry(_take)
reduce = curry(reduce)

go = lambda *args: reduce(lambda a,f: f(a), args) ## 함수도 축약 가능 ##
##############################################################################################################

# The inputs to this node will be stored as a list in the IN variables.
dataEnteringNode = IN
contents = IN[0]
folderPath = IN[1]
cwd = folderPath
portNo = IN[2]
#bdName = IN[2]
# Place your code below this line

def find_cwd():
    doc = Revit.Application.Document.Current
    filePath_string = doc.FilePath
    folderPath = filePath_string.split('\\')
    folderPath.pop(-1)
    folderPath_str = '\\'.join(folderPath)
    return folderPath_str

def make_resultHTMLname(htmlStr,title,cwd):
    timeStamp = time.strftime('%H_%M_%S', time.localtime(time.time()))
    #folderPath = f"{cwd}\\.dynLog"
    folderPath = cwd
    if not os.path.exists(folderPath):
        os.makedirs(folderPath)
    fileName = f"index.html"
    filePath = f"{folderPath}\\" + fileName
    f = open(filePath, 'w', encoding='utf8')
    f.write(htmlStr)
    f.close()
    return fileName

def execute_browser(cwd, fileName):
    #cwd = find_cwd()
    folderPath = cwd
    os.chdir(folderPath)
    #cmdStr = "start chrome http:localhost:8000"
    filePath = folderPath + '/' + fileName
    #cmdStr = f'start msedge "{filePath}"'
    #cmdList= cmdStr.split(' ')
    cmdList = [
        "start",
        "msedge",
        f'{filePath}',
    ]
    
    
    #subprocess.run(args=[fileName], shell=True)
    #subprocess.run(args=['start','excel',fileName], shell=True)
    subprocess.run(args=cmdList, shell=True)
    return cmdList

def execute_browser_server(cwd):
    #cwd = find_cwd()
    folderPath = cwd
    os.chdir(folderPath)
    #cmdStr = "start chrome http:localhost:8000"
    cmdStr = f'start msedge http:localhost:{portNo}'
    cmdList= cmdStr.split(' ')
    #subprocess.run(args=[fileName], shell=True)
    #subprocess.run(args=['start','excel',fileName], shell=True)
    subprocess.run(args=cmdList, shell=True)
    return cmdList


fileName = make_resultHTMLname(contents,"test",cwd)
print(fileName)

# Assign your output to the OUT variable.
OUT = execute_browser(cwd, fileName)#fileName.split('.')[0]
# ----------------------------------------
create_js_file = Python(IN[0]=javascriptPart, IN[1]=htmlPath_new)  # CPython3; frozen; unwired: IN[2]
# ---------- create_js_file.python (84 lines) ----------
# Load the Python Standard and DesignScript Libraries
import os
import sys
import clr
clr.AddReference('ProtoGeometry')
from Autodesk.DesignScript.Geometry import *

clr.AddReference('RevitNodes')
import Revit
clr.ImportExtensions(Revit.Elements)
from Revit import Elements

import time
import subprocess

#################################Module For Functional Programing#############################################
from functools import reduce
curry = lambda f: lambda a,*args: f(a, *args) if (len(args)) else lambda *args: f(a, *args)

filter = curry(filter)
map = curry(map)

def _take(length, iter):
    res = []
    for a in iter:
        res.append(a)
        if len(res) == length:
            return res
        
take = curry(_take)
reduce = curry(reduce)

go = lambda *args: reduce(lambda a,f: f(a), args) ## 함수도 축약 가능 ##
##############################################################################################################

# The inputs to this node will be stored as a list in the IN variables.
dataEnteringNode = IN
contents = IN[0]
folderPath = IN[1]
#bdName = IN[2]
# Place your code below this line
def find_cwd():
    doc = Revit.Application.Document.Current
    filePath_string = doc.FilePath
    folderPath = filePath_string.split('\\')
    folderPath.pop(-1)
    folderPath_str = '\\'.join(folderPath)
    return folderPath_str

#cwd = find_cwd()
cwd = folderPath

def make_resultHTMLname(jsStr,cwd):
    #timeStamp = time.strftime('%H_%M_%S', time.localtime(time.time()))
    #folderPath = f"{cwd}\\.dynLog"
    folderPath = cwd
    jsPath = cwd + "\\js"
    if not os.path.exists(folderPath):
        os.makedirs(folderPath)
    if not os.path.exists(jsPath):
        os.makedirs(jsPath)
    fileName = "script.js"
    filePath = f"{jsPath}\\" + fileName
    f = open(filePath, 'w', encoding='utf8')
    f.write(jsStr)
    f.close()
    return fileName

def execute_file(fileName):
    #cwd = find_cwd()
    folderPath = cwd
    os.chdir(folderPath)
    subprocess.run(args=[fileName], shell=True)
    #subprocess.run(args=['start','excel',fileName], shell=True)
    

fileName = make_resultHTMLname(contents,cwd)
#fileName = "Test1.html"

#execute_file(fileName)


# Assign your output to the OUT variable.
OUT = fileName
# ----------------------------------------
start_webserver = Python(IN[0]=htmlPath_new, IN[1]=set_port_number_기본값_8100_작동_오류)  # CPython3; frozen
# ---------- start_webserver.python (48 lines) ----------
# Load the Python Standard and DesignScript Libraries
import sys
import clr
clr.AddReference('ProtoGeometry')
from Autodesk.DesignScript.Geometry import *

import os
import asyncio
import multiprocessing
import subprocess
# The inputs to this node will be stored as a list in the IN variables.
dataEnteringNode = IN
cwd = IN[0]
portNo = IN[1]
# Place your code below this line
batStr = f"""
@echo on
python -m http.server {portNo}
cmd /k
"""
##cmd /k
title = "localWebserver"

def make_startSever_bat(batStr,title,cwd):
    folderPath = cwd
    if not os.path.exists(folderPath):
        os.makedirs(folderPath)
    fileName = f"{title}.bat"
    filePath = f"{folderPath}\\" + fileName
    f = open(filePath, 'w', encoding='utf8')
    f.write(batStr)
    f.close()
    return fileName

def startBat(fileName, cwd):
    cmdStr = f".\\{fileName}"
    cmdList= cmdStr.split(' ')
    os.chdir(cwd)
    
    res = subprocess.Popen(args=cmdList, shell=True)
    return res

batFileName = make_startSever_bat(batStr,title,cwd)
#res = multiprocessing.Process(name="SubProcess", target=startBat, args=(batFileName, cwd))
# Assign your output to the OUT variable.
OUT = startBat(batFileName, cwd)

#startBat(fileName, cwd)
# ----------------------------------------

tablePart = Python()  # CPython3; frozen; unwired: IN[0]
# ---------- tablePart.python (41 lines) ----------
# Load the Python Standard and DesignScript Libraries
import sys
import clr
clr.AddReference('ProtoGeometry')
from Autodesk.DesignScript.Geometry import *

# The inputs to this node will be stored as a list in the IN variables.
dataEnteringNode = IN
rows = IN[0]
#hdr = rows[0]
# Place your code below this line
def make_th(hdr):
    preStr = "<tr>"
    postStr = "</tr>"
    hdrStrs = list(map(lambda x: f"<th>{x}</th>", hdr))
    res = "\n".join([preStr]+hdrStrs+[postStr])
    return res

def make_tr(row):
    preStr = "<tr>"
    postStr = "</tr>"
    if row[0] != "":
        rowStrs = list(map(lambda x: f"<th>{x}</th>", row))
    else:
        rowStrs = list(map(lambda x: f"<td>{x}</td>", row))
    res = "\n".join([preStr]+rowStrs+[postStr])
    return res

def make_trs(rows):
    rowsWithoutHdr = rows[1:]
    rowsStrs = list(map(make_tr, rowsWithoutHdr))
    res = "\n".join(rowsStrs)
    return res

def make_wholeTable(th,trs):
    preStr = "<table>"
    postStr = "</table>"
    res = "\n".join([preStr, th, trs, postStr])
    return res
# Assign your output to the OUT variable.
OUT = 0#make_wholeTable(make_th(hdr), make_trs(rows))
# ----------------------------------------
# note: <script type ="module" src="./js/script.js"></script>
watch = Watch(htmlPath_new)  # graph output
make_htmlStr_3 = Python()  # CPython3; frozen; unwired: IN[0], IN[1], IN[2]
# ---------- make_htmlStr_3.python (39 lines) ----------
# Load the Python Standard and DesignScript Libraries
import sys
import clr
clr.AddReference('ProtoGeometry')
from Autodesk.DesignScript.Geometry import *

# The inputs to this node will be stored as a list in the IN variables.
dataEnteringNode = IN
jsPart = IN[0]
cssPart = IN[1]
tablePart = IN[2]

# Place your code below this line
##folderPath_r = folderPath.replace('\\','\\\\')

htmlStr = f'''
<!DOCTYPE html>
<html lang="ko">

<head>
    <meta charset="UTF-8">
    <title>my first three.js app</title>
    <style>
        {cssPart}
    </style>
</head>

<body>



<script type ="module" src="./js/script.js">

</body>

</html>
'''
# Assign your output to the OUT variable.
OUT = htmlStr
# ----------------------------------------

# group: Get Grid Datas
categories_7 = Categories("OST_Grids")
all_elements_of_category_7 = ElementsOfCategory(Category=categories_7)
parameters_2 = Element.Parameters(element=all_elements_of_category_7)
code_block_30 = CodeBlock { "Name"; }
getParameterValueByName = Element.GetParameterValueByName(element=all_elements_of_category_7, parameterName=code_block_30)
code_block_31 = CodeBlock { 0; 1; }
substring = String.Substring(string=getParameterValueByName, startIndex=code_block_31.out0, length=code_block_31.out1)
groupByKey_2 = List.GroupByKey(list=all_elements_of_category_7, keys=substring)
code_block_32 = CodeBlock { "Name"; }
getParameterValueByName_2 = Element.GetParameterValueByName(element=groupByKey_2.groups, parameterName=code_block_32)
sortByKey_3 = List.SortByKey(list=groupByKey_2.groups@L2, keys=getParameterValueByName_2@L2)
code_block_33 = CodeBlock(i=sortByKey_3.sortedList) { i; }
code_block_34 = CodeBlock(keys=sortByKey_3.sortedKeys) { keys; }

# group: get Level Datas
categories_8 = Categories("OST_Levels")
all_elements_of_category_8 = ElementsOfCategory(Category=categories_8)
parameters_3 = Element.Parameters(element=all_elements_of_category_8)
elevation = Level.Elevation(level=all_elements_of_category_8)
round = Math.Round(number=elevation)
sortByKey_4 = List.SortByKey(list=all_elements_of_category_8, keys=round)
code_block_35 = CodeBlock { "Name"; }
getParameterValueByName_3 = Element.GetParameterValueByName(element=sortByKey_4.sortedList, parameterName=code_block_35)
elevation_2 = Level.Elevation(level=sortByKey_4.sortedList)
round_2 = Math.Round(number=elevation_2)

# group: About View
categories_9 = Categories("OST_Views")
all_elements_of_category_9 = ElementsOfCategory(Category=categories_9)
code_block_36 = CodeBlock(i=all_elements_of_category_9) { i!=null; }
filterByBoolMask_4 = List.FilterByBoolMask(list=all_elements_of_category_9, mask=code_block_36)
name_3 = Element.Name(element=filterByBoolMask_4.in)
code_block_37 = CodeBlock { "3D_AR"; }
contains = String.Contains(string=name_3, searchFor=code_block_37)
filterByBoolMask_5 = List.FilterByBoolMask(list=filterByBoolMask_4.in, mask=contains)
code_block_38 = CodeBlock(i=filterByBoolMask_5.in) { i[0]; }
parameters_4 = Element.Parameters(element=filterByBoolMask_4.in)

code_block_39 = CodeBlock(i=htmlPath_new) { i + "\\3d.jpg"; }
exportAsImage = View.ExportAsImage(view=code_block_38, path=code_block_39)
code_block_40 = CodeBlock(cols=code_block_9.out0) { cols; }
warning_about_rooms = Python(IN[0]=code_block_15)  # CPython3; graph output
# ---------- warning_about_rooms.python (19 lines) ----------
# Load the Python Standard and DesignScript Libraries
import sys
import clr
clr.AddReference('ProtoGeometry')
from Autodesk.DesignScript.Geometry import *

# The inputs to this node will be stored as a list in the IN variables.
dataEnteringNode = IN
placedRooms = IN[0]
# Place your code below this line

def warnAbtRooms(placedRooms):
    if len(placedRooms):
        pass
    else:
        return "There are no placed rooms !!!"

# Assign your output to the OUT variable.
OUT = warnAbtRooms(placedRooms)
# ----------------------------------------
code_block_41 = CodeBlock(portNumber=set_port_number_기본값_8100_작동_오류) { portNumber; }
watch_2 = Watch(code_block_9.out0)
watch_3 = Watch(code_block_9.out1)
