# Dynamo graph [H_PAB.RT.G4]_Revit 모델링 변경사항 추적기_0.0.1.dyn (Dynamo 3.3.0.6316)

tracking = Python()  # CPython3; unwired: IN[0]
# ---------- tracking.python (192 lines) ----------
import clr
clr.AddReference('RevitAPI')
clr.AddReference('RevitServices')
from Autodesk.Revit.DB import *
from RevitServices.Persistence import DocumentManager
import json, os

doc = DocumentManager.Instance.CurrentDBDocument
app = DocumentManager.Instance.CurrentUIApplication.Application

# 📁 기본 스냅샷 폴더 경로
base_dir = r"D:\.Temp_forDyn"

# 📄 모델 파일명으로 폴더명 결정
model_title = doc.Title  # 예: MyProject.rvt
model_folder = os.path.join(base_dir, model_title.replace(".rvt", ""))

# 📁 폴더 없으면 생성
if not os.path.exists(model_folder):
    os.makedirs(model_folder)

snapshot_file = os.path.join(model_folder, "prev_snapshot.json")

# 🔍 현재 모델 요소 스냅샷 함수
def capture_elements(doc):
    elements = []

    # 일반 요소 수집
    collector = FilteredElementCollector(doc).WhereElementIsNotElementType().ToElements()
    for el in collector:
        try:
            if el.Category and el.Category.Name in [
                "Walls", "Floors", "Doors", "Windows",
                "Structural Columns", "Structural Foundations",
                "Structural Framing", "Ceilings", "Stairs", "Railings"
            ]:
                # Level 추출 보완
                level = "N/A"
                if hasattr(el, "LevelId") and el.LevelId.IntegerValue > 0:
                    level = doc.GetElement(el.LevelId).Name
                elif el.LookupParameter("Reference Level"):
                    level = el.LookupParameter("Reference Level").AsValueString()

                data = {
                    "id": el.Id.IntegerValue,
                    "category": el.Category.Name,
                    "type": el.Name,
                    "level": level,
                    "params": {}
                }
                for p in el.Parameters:
                    if p.StorageType in [StorageType.String, StorageType.Double, StorageType.Integer]:
                        try:
                            val = p.AsValueString() or p.AsString() or p.AsInteger()
                            data["params"][p.Definition.Name] = str(val)
                        except:
                            pass
                elements.append(data)
        except:
            continue

    # ✅ Room 별도 수집
    room_collector = FilteredElementCollector(doc).OfCategory(BuiltInCategory.OST_Rooms).WhereElementIsNotElementType()
    for room in room_collector:
        try:
            data = {
                "id": room.Id.IntegerValue,
                "category": "Rooms",
                "type": "Room",
                "level": room.Level.Name if room.Level else "N/A",
                "params": {
                    "Number": room.LookupParameter("Number").AsString(),
                    "Name": room.LookupParameter("Name").AsString(),
                    "Area": room.LookupParameter("Area").AsValueString()
                }
            }
            elements.append(data)
        except:
            continue

    return elements


# 📄 이전 스냅샷 불러오기
if os.path.exists(snapshot_file):
    with open(snapshot_file, 'r') as f:
        prev_elements = json.load(f)
else:
    prev_elements = []

# 📥 현재 상태
curr_elements = capture_elements(doc)

def get_room_info(el):
    return {
        "number": el.LookupParameter("Number").AsString() if el.LookupParameter("Number") else "N/A",
        "name": el.LookupParameter("Name").AsString() if el.LookupParameter("Name") else "N/A",
        "area": el.LookupParameter("Area").AsValueString() if el.LookupParameter("Area") else "N/A"
    }

# 📌 변경 탐지 함수
def get_diff(prev, curr):
    diff = []
    prev_dict = {str(e["id"]): e for e in prev}
    curr_dict = {str(e["id"]): e for e in curr}

    # 🔧 중요 파라미터 목록 (카테고리별)
    important_params_by_category = {
        "Structural Columns": ["Unconnected Height", "Top Level", "Base Level", "Top Offset", "Base Offset"],
        "Structural Foundations": ["Level", "Thickness", "Length", "Width", "Height Offset From Level"],
        "Floors": ["Level", "Thickness", "Height Offset from Level"],
        "Ceilings": ["Thickness", "Height Offset from Level"],
        "Walls": ["Unconnected Height", "Location Line", "Base Constraint", "Base Offset", "Top Constraint", "Top Offset", "Length", "Area", "Volume"],
        "Doors": ["Level", "Sill Height", "Head Height", "Mark"],
        "Windows": ["Level", "Sill Height", "Head Height", "Mark"],
        "Stairs": ["Top Level", "Top Offset", "Base Level", "Base Offset"],
        "Railings": ["Base Level", "Base Offset"]
    }

    def safe_float(val):
        try:
            return round(float(val), 4)
        except:
            return val

    # 🔹 삭제된 요소
    for eid in prev_dict:
        if eid not in curr_dict:
            el = prev_dict[eid]
            if el["category"] == "Rooms":
                diff.append(f"[삭제] Room '{el['params'].get('Number')} - {el['params'].get('Name')}' (면적: {el['params'].get('Area')})")
            else:
                diff.append(f"[삭제] {el['category']} '{el['type']}' (Level: {el['level']})")

    # 🔹 새로 추가된 요소
    for eid in curr_dict:
        if eid not in prev_dict:
            el = curr_dict[eid]
            if el["category"] == "Rooms":
                diff.append(f"[추가] Room '{el['params'].get('Number')} - {el['params'].get('Name')}' (면적: {el['params'].get('Area')})")
            else:
                diff.append(f"[추가] {el['category']} '{el['type']}' (Level: {el['level']})")

    # 🔹 수정된 요소
    for eid in curr_dict:
        if eid in prev_dict:
            prev_el = prev_dict[eid]
            curr_el = curr_dict[eid]

            # ✅ Room 변경 감지
            if curr_el["category"] == "Rooms":
                prev_info = prev_el["params"]
                curr_info = curr_el["params"]
                room_number = curr_info.get("Number", "N/A")
                room_name = curr_info.get("Name", "N/A")
                if prev_info.get("Name") != curr_info.get("Name"):
                    diff.append(f"[이름 변경] Room '{room_number}': '{prev_info.get('Name')}' → '{curr_info.get('Name')}'")
                if prev_info.get("Area") != curr_info.get("Area"):
                    diff.append(f"[면적 변경] Room '{room_number} - {room_name}': {prev_info.get('Area')} → {curr_info.get('Area')}")
                continue

            # ✅ 타입 변경 감지
            if prev_el["type"] != curr_el["type"]:
                diff.append(f"[타입 변경] {curr_el['category']} ID {eid} : '{prev_el['type']}' → '{curr_el['type']}'")

            # ✅ 중요 파라미터 변경 감지
            important_params = important_params_by_category.get(curr_el["category"], [])
            param_changes = []
            for param_name in important_params:
                prev_val = prev_el["params"].get(param_name)
                curr_val = curr_el["params"].get(param_name)
                if safe_float(prev_val) != safe_float(curr_val):
                    param_changes.append(f"{param_name}: {prev_val} → {curr_val}")
            if param_changes:
                diff.append(
                    f"[속성 변경] {curr_el['category']} '{curr_el['type']}' (Level: {curr_el['level']}): " +
                    "; ".join(param_changes)
                )

    return diff



# 결과 생성
diff = get_diff(prev_elements, curr_elements)
summary = "\n".join(diff) if diff else "변경 사항 없음 ✅"

# 📥 현재 상태 저장
with open(snapshot_file, 'w') as f:
    json.dump(curr_elements, f, indent=2)

OUT = summary
# ----------------------------------------
watch = Watch(tracking)  # graph output
