# Dynamo graph [H_PAB.RT.M2]_Revit 룸경계 기반 마감벽체 생성기_[3.0.0].dyn "공통_Plaster Wall Maker_1.0.0" (Dynamo 2.16.1.2727)
# author: MK Jang
# Summary of Revit File

# group: get Room Datas
rooms_by_status = RoomsByStatus()
code_block = CodeBlock(i=rooms_by_status.PlacedRooms) { i; }
parameters = Element.Parameters(element=code_block)
code_block_2 = CodeBlock()
# ---------- code_block_2.designscript (10 lines) ----------
[
"Name",
"Number",
"Level",
"Area",
"H_Floor Finish Style Name",
"H_Skirt Finish Style Name",
"H_Wall Finish Style Name",
"H_Ceiling Finish Style Name"
];
# ----------------------------------------
parameterByName = Parameter.ParameterByName(element=code_block@L1, name=code_block_2)
code_block_3 = CodeBlock { 1; }
code_block_4 = CodeBlock()
# ---------- code_block_4.designscript (10 lines) ----------
[
"Name",
"Number",
"Level",
"Area",
"Floor Finish Style No",
"Skirt Finish Style No",
"Wall Finish Style No",
"Ceiling Finish Style No"
];
# ----------------------------------------

# group: All Elements in Revit
all_elementsexceptrails = Python()  # CPython3; unwired: IN[0]
# ---------- all_elementsexceptrails.python (51 lines) ----------
# Load the Python Standard and DesignScript Libraries
import sys
import clr
clr.AddReference('ProtoGeometry')
from Autodesk.DesignScript.Geometry import *

clr.AddReference('RevitAPI')
from Autodesk.Revit.DB import *
import Autodesk

clr.AddReference('RevitServices')
import RevitServices
from RevitServices.Persistence import DocumentManager
doc = DocumentManager.Instance.CurrentDBDocument

def get_all_BIC():

    db = [
    Autodesk.Revit.DB.BuiltInCategory.OST_Floors,
    Autodesk.Revit.DB.BuiltInCategory.OST_Roofs,
    Autodesk.Revit.DB.BuiltInCategory.OST_Walls,
    Autodesk.Revit.DB.BuiltInCategory.OST_StructuralFoundation,
    Autodesk.Revit.DB.BuiltInCategory.OST_StructuralColumns,
    Autodesk.Revit.DB.BuiltInCategory.OST_StructuralFraming,
    Autodesk.Revit.DB.BuiltInCategory.OST_Ceilings,
    Autodesk.Revit.DB.BuiltInCategory.OST_Doors,
    Autodesk.Revit.DB.BuiltInCategory.OST_Windows,
    #Autodesk.Revit.DB.BuiltInCategory.OST_Stairs,
    #Autodesk.Revit.DB.BuiltInCategory.OST_Railings,
    ]
    return db
    
def get_allElems(doc):
    bics = get_all_BIC()
    
    def getElems(x):
        collector = FilteredElementCollector(doc)
        res = collector.OfCategory(x).WhereElementIsNotElementType().ToElements()
        return res

    def getRailElems(x):
        collector = FilteredElementCollector(doc)
        res = collector.OfCategory(x).WhereElementIsNotElementType()
        return res

    res = map(getElems, bics)
#    res = getRailElems(Autodesk.Revit.DB.BuiltInCategory.OST_RailingSystemRail)
    return res


OUT = get_allElems(doc)
# ----------------------------------------
categories = Categories("OST_Stairs")
all_elements_of_category = ElementsOfCategory(Category=categories)
list_create = List.Create(item0=all_elements_of_category)
categories_2 = Categories("OST_StairsRailing")
all_elements_of_category_2 = ElementsOfCategory(Category=categories_2)
list_create_2 = List.Create(item0=all_elements_of_category_2)
categories_3 = Categories("OST_GenericModel")
all_elements_of_category_3 = ElementsOfCategory(Category=categories_3)
list_create_3 = List.Create(item0=all_elements_of_category_3)
join = List.Join(list0=all_elementsexceptrails, list1=list_create, list2=list_create_2, list3=list_create_3)

exportAsImage = View.ExportAsImage()  # unwired: view, path
n5_플라스터월_패밀리_명_입력 = StringInput("H_WA_AR_B07_Int Wall_Plaster T12")  # "5. 플라스터월 패밀리 명 입력"; graph input
byName = WallType.ByName(name=n5_플라스터월_패밀리_명_입력)
parameters_2 = Element.Parameters(element=byName)
n1_room_객체_선택 = DSModelElementByCategorySelection("OST_Rooms")  # "1. Room 객체 선택"; 1 picked in the model; graph input
finishBoundary = Room.FinishBoundary(room=n1_room_객체_선택)
byJoinedCurves = PolyCurve.ByJoinedCurves(curves=finishBoundary)
code_block_5 = CodeBlock { "Width"; }
getParameterValueByName = Element.GetParameterValueByName(element=byName, parameterName=code_block_5)
code_block_6 = CodeBlock { -0.5; }
mul = getParameterValueByName * code_block_6
boolean = BoolSelector(false)
offsetMany = PolyCurve.OffsetMany(polyCurve=byJoinedCurves, signedDistance=mul, extendCircular=boolean)
curves = PolyCurve.Curves(polyCurve=offsetMany)
n4_플라스터월_높이_입력 = DoubleInput(2700)  # "4. 플라스터월 높이 입력"; graph input
n2_벽체_하단_기준_레벨선택 = Levels("TOF")  # "2. 벽체 하단 기준 레벨선택"; graph input
byCurveAndHeight = Wall.ByCurveAndHeight(curve=curves, height=n4_플라스터월_높이_입력, level=n2_벽체_하단_기준_레벨선택, wallType=byName)
code_block_7 = CodeBlock { "Base Offset"; }
n3_기준레벨에서_띄울_높이_입력 = DoubleInput(0)  # "3. 기준레벨에서 띄울 높이 입력"; graph input
setParameterByName = Element.SetParameterByName(element=byCurveAndHeight, parameterName=code_block_7, value=n3_기준레벨에서_띄울_높이_입력)
watch = Watch(setParameterByName)  # graph output
