# Dynamo graph [H_PAB.RT.Q2A]_Revit 토공 물량 자동산출_[0.1.4].dyn (Dynamo 3.3.0.6316)
# author: MK Jang
# Auto Calculating the Quantities of each Element As per the Family List

building_name = CodeBlock { bdName; }  # unwired: bdName

# group: HTML 부재별 물량 기입 구간
javascriptPart = Python()  # CPython3; unwired: IN[0], IN[1], IN[2]
# ---------- javascriptPart.python (59 lines) ----------
# Load the Python Standard and DesignScript Libraries
import sys
import clr
clr.AddReference('ProtoGeometry')
from Autodesk.DesignScript.Geometry import *

# The inputs to this node will be stored as a list in the IN variables.
dataEnteringNode = IN

# Place your code below this line
jsPart = '''
function hideAllPages() {
        document.querySelector("#home").style.fontWeight = "normal";
        document.querySelector("#homePage").style.display = "None";
        document.querySelector("#info").style.fontWeight = "normal";
        document.querySelector("#infoPage").style.display = "None";
        document.querySelector("#famType").style.fontWeight = "normal";
        document.querySelector("#famTypePage").style.display = "None";
        document.querySelector("#roomInfo").style.fontWeight = "normal";
        document.querySelector("#roomInfoPage").style.display = "None";
        document.querySelector("#roomInfoPage_chk").style.display = "None";
}

document.querySelector("#cat").onclick = function() {
	    let img = document.createElement("img");
	    img.setAttribute("src", "https://t4.ftcdn.net/jpg/05/62/99/31/360_F_562993122_e7pGkeY8yMfXJcRmclsoIjtOoVDDgIlh.jpg");
	    document.querySelector("#cat").style.display = "None";
	    img.setAttribute("style", "width:300px;margin-top:20px;")
	    document.body.append(img);
	};
document.querySelector("#home").onclick = function() {
        hideAllPages();
        document.querySelector("#home").style.fontWeight = "bolder";
        document.querySelector("#homePage").style.display = "inline";
	};
document.querySelector("#info").onclick = function() {
        hideAllPages();
        document.querySelector("#info").style.fontWeight = "bolder";
        document.querySelector("#infoPage").style.display = "inline";
	};
document.querySelector("#famType").onclick = function() {
        hideAllPages();
        document.querySelector("#famType").style.fontWeight = "bolder";
        document.querySelector("#famTypePage").style.display = "inline";
	};
document.querySelector("#roomInfo").onclick = function() {
        hideAllPages();
        document.querySelector("#roomInfo").style.fontWeight = "bolder";
        document.querySelector("#roomInfoPage").style.display = "inline";
	};
document.querySelector("#roomInfo_chk").onclick = function() {
        hideAllPages();
        document.querySelector("#roomInfo_chk").style.fontWeight = "bolder";
        document.querySelector("#roomInfoPage_chk").style.display = "inline";
	};
	
'''
# Assign your output to the OUT variable.
OUT = jsPart
# ----------------------------------------
cssPart = Python()  # CPython3; unwired: IN[0], IN[1], IN[2]
# ---------- cssPart.python (125 lines) ----------
# Load the Python Standard and DesignScript Libraries
import sys
import clr
clr.AddReference('ProtoGeometry')
from Autodesk.DesignScript.Geometry import *

# The inputs to this node will be stored as a list in the IN variables.
dataEnteringNode = IN

# Place your code below this line
cssPart = '''

/* style.css */
img {
 width : 25%;
 height: 25%; 
}

:root {
  --text-color: #f0f4f5;
  --background-color: #263343;
  --accent-color: orange;
  --icons-color: rgb(152, 187, 201);
  --bodybackground-color: lightgray;
}

th {
  text-align: center;
  padding-left: 30px;
}

td {
  padding-left: 40px;
  border-bottom : 1px solid gray;
  border-collapse : collapse;
}

body {
  margin: 0;
  background-color: var(--bodybackground-color);
  font-family: 'STIX Two Math';
} 

a {
  text-decoration: none;
  color: var(--text-color);
}

.navbar {
  display: flex;
  position: sticky;
  top: 0px; /* 도달했을때 고정시킬 위치 */
  justify-content: space-between;
  align-items: center;
  background-color: var(--background-color);
  padding: 8px 12px;
  font-family: 'STIX Two Math';
}

.navbar__logo i {
  color: var(--accent-color);
  padding-left: 0;
}

.navbar__menu {
  list-style: none;
  display: flex;
  margin: 0;
  padding-left: 0;
}

.navbar__menu li {
  padding: 8px 30px;
  color: var(--text-color);
}

.navbar__menu li:hover {
  background-color: var(--accent-color);
  border-radius: 3px;
}

.navbar__icons {
  list-style: none;
  display: flex;
  color: var(--icons-color);
  margin: 0;
  padding-left: 0;
}

.navbar__icons li {
  padding: 8px 12px;
  margin: 0;
}

#cat {
  display: block;
  }

#home {
  font-weight: bolder;
  }

#homePage {
  display: inline;
  }

#infoPage {
  display: None;
  }

#famTypePage {
  display: None;
  }

#roomInfoPage {
  display: None;
  }

#roomInfoPage_chk {
  display: None;
  }

'''
# Assign your output to the OUT variable.
OUT = cssPart
# ----------------------------------------
navHTML_Part = Python()  # CPython3; unwired: IN[0]
# ---------- navHTML_Part.python (24 lines) ----------
# Load the Python Standard and DesignScript Libraries
import sys
import clr
clr.AddReference('ProtoGeometry')
from Autodesk.DesignScript.Geometry import *

# The inputs to this node will be stored as a list in the IN variables.
dataEnteringNode = IN

# Place your code below this line
navPart = f"""

<nav class="navbar">

  <ul class="navbar__menu">
    <li id="home">Home</li>
  </ul>

</nav>

"""

# Assign your output to the OUT variable.
OUT = navPart
# ----------------------------------------
list_create = List.Create()  # unwired: item0
make_htmlStr = Python(IN[0]=javascriptPart, IN[1]=cssPart, IN[2]=navHTML_Part, IN[3]=building_name, IN[4]=list_create)  # CPython3; frozen
# ---------- make_htmlStr.python (59 lines) ----------
# Load the Python Standard and DesignScript Libraries
import sys
import clr
clr.AddReference('ProtoGeometry')
from Autodesk.DesignScript.Geometry import *

# The inputs to this node will be stored as a list in the IN variables.
dataEnteringNode = IN
jsPart = IN[0]
cssPart = IN[1]
navPart = IN[2]

pjtName = IN[3][0]
bdName = IN[3][1]
pages = IN[4]

homePage = pages[0]



# Place your code below this line
##folderPath_r = folderPath.replace('\\','\\\\')

htmlStr = f'''
<!DOCTYPE html>
<html lang="ko">

<head>
    <link rel="shortcut icon" href="#">
    <meta charset="UTF-8">
    <title>RVT Calculation Result</title>
    <style>
        {cssPart}
    </style>
</head>

<header>
<h5>Revit Elements' Bill of Quantities Page</h5>
<h4>{pjtName}</h4>
<h4>{bdName}</h4>
</header>

<body>
{navPart}

<div id="homePage">
{homePage}
</div>



<script type ="module" src="./js/script.js"></script>

</body>

</html>
'''
# Assign your output to the OUT variable.
OUT = htmlStr
# ----------------------------------------
code_block = CodeBlock(htmlStr=make_htmlStr) { htmlStr; }
serverFilePath = CodeBlock { ".dynTemp"; }
htmlPath = Python(IN[0]=serverFilePath)  # CPython3
# ---------- htmlPath.python (35 lines) ----------
# Load the Python Standard and DesignScript Libraries
import sys
import clr
clr.AddReference('ProtoGeometry')
from Autodesk.DesignScript.Geometry import *
import time
import subprocess
import os

clr.AddReference('RevitNodes')
import Revit
clr.ImportExtensions(Revit.Elements)
from Revit import Elements
# The inputs to this node will be stored as a list in the IN variables.
dataEnteringNode = IN
dynTempServerPath = IN[0]
# Place your code below this line
def find_cwd():
    doc = Revit.Application.Document.Current
    filePath_string = doc.FilePath
    folderPath = filePath_string.split('\\')
    folderPath.pop(-1)
    folderPath_str = '\\'.join(folderPath)
    return folderPath_str

cwd = find_cwd()
#cwd = os.getenv("HomePath")

folderPath = f"{cwd}\\{dynTempServerPath}\\tmpForBOQ"
if not os.path.exists(folderPath):
    os.makedirs(folderPath)

# Assign your output to the OUT variable.
#OUT = "C:"+folderPath
OUT = folderPath
# ----------------------------------------
n0_set_port_number_기본값_8000_작동_오류 = StringInput("8000")  # "0. Set Port Number: 기본값-8000 (작동 오류 없다면 변경 금지)"
create_html_file_and_open = Python(IN[0]=code_block, IN[1]=htmlPath, IN[2]=n0_set_port_number_기본값_8000_작동_오류)  # CPython3
# ---------- create_html_file_and_open.python (85 lines) ----------
# Load the Python Standard and DesignScript Libraries
import os
import sys
import clr
clr.AddReference('ProtoGeometry')
from Autodesk.DesignScript.Geometry import *

clr.AddReference('RevitNodes')
import Revit
clr.ImportExtensions(Revit.Elements)
from Revit import Elements

import time
import subprocess
import asyncio
import multiprocessing

#################################Module For Functional Programing#############################################
from functools import reduce
curry = lambda f: lambda a,*args: f(a, *args) if (len(args)) else lambda *args: f(a, *args)

filter = curry(filter)
map = curry(map)

def _take(length, iter):
    res = []
    for a in iter:
        res.append(a)
        if len(res) == length:
            return res
        
take = curry(_take)
reduce = curry(reduce)

go = lambda *args: reduce(lambda a,f: f(a), args) ## 함수도 축약 가능 ##
##############################################################################################################

# The inputs to this node will be stored as a list in the IN variables.
dataEnteringNode = IN
contents = IN[0]
folderPath = IN[1]
cwd = folderPath
portNo = IN[2]
#bdName = IN[2]
# Place your code below this line

def find_cwd():
    doc = Revit.Application.Document.Current
    filePath_string = doc.FilePath
    folderPath = filePath_string.split('\\')
    folderPath.pop(-1)
    folderPath_str = '\\'.join(folderPath)
    return folderPath_str

def make_resultHTMLname(htmlStr,title,cwd):
    timeStamp = time.strftime('%H_%M_%S', time.localtime(time.time()))
    #folderPath = f"{cwd}\\.dynLog"
    folderPath = cwd
    if not os.path.exists(folderPath):
        os.makedirs(folderPath)
    fileName = f"index.html"
    filePath = f"{folderPath}\\" + fileName
    f = open(filePath, 'w', encoding='utf8')
    f.write(htmlStr)
    f.close()
    return fileName


def execute_browser(cwd):
    #cwd = find_cwd()
    folderPath = cwd
    os.chdir(folderPath)
    #cmdStr = "start chrome http:localhost:8000"
    cmdStr = f"start msedge http:localhost:{portNo}"
    cmdList= cmdStr.split(' ')
    #subprocess.run(args=[fileName], shell=True)
    #subprocess.run(args=['start','excel',fileName], shell=True)
    subprocess.run(args=cmdList, shell=True)
    return cmdList


fileName = make_resultHTMLname(contents,"test",cwd)

# Assign your output to the OUT variable.
OUT = execute_browser(cwd)#fileName.split('.')[0]
# ----------------------------------------
create_js_file = Python(IN[0]=javascriptPart, IN[1]=htmlPath)  # CPython3; unwired: IN[2]
# ---------- create_js_file.python (84 lines) ----------
# Load the Python Standard and DesignScript Libraries
import os
import sys
import clr
clr.AddReference('ProtoGeometry')
from Autodesk.DesignScript.Geometry import *

clr.AddReference('RevitNodes')
import Revit
clr.ImportExtensions(Revit.Elements)
from Revit import Elements

import time
import subprocess

#################################Module For Functional Programing#############################################
from functools import reduce
curry = lambda f: lambda a,*args: f(a, *args) if (len(args)) else lambda *args: f(a, *args)

filter = curry(filter)
map = curry(map)

def _take(length, iter):
    res = []
    for a in iter:
        res.append(a)
        if len(res) == length:
            return res
        
take = curry(_take)
reduce = curry(reduce)

go = lambda *args: reduce(lambda a,f: f(a), args) ## 함수도 축약 가능 ##
##############################################################################################################

# The inputs to this node will be stored as a list in the IN variables.
dataEnteringNode = IN
contents = IN[0]
folderPath = IN[1]
#bdName = IN[2]
# Place your code below this line
def find_cwd():
    doc = Revit.Application.Document.Current
    filePath_string = doc.FilePath
    folderPath = filePath_string.split('\\')
    folderPath.pop(-1)
    folderPath_str = '\\'.join(folderPath)
    return folderPath_str

#cwd = find_cwd()
cwd = folderPath

def make_resultHTMLname(jsStr,cwd):
    #timeStamp = time.strftime('%H_%M_%S', time.localtime(time.time()))
    #folderPath = f"{cwd}\\.dynLog"
    folderPath = cwd
    jsPath = cwd + "\\js"
    if not os.path.exists(folderPath):
        os.makedirs(folderPath)
    if not os.path.exists(jsPath):
        os.makedirs(jsPath)
    fileName = "script.js"
    filePath = f"{jsPath}\\" + fileName
    f = open(filePath, 'w', encoding='utf8')
    f.write(jsStr)
    f.close()
    return fileName

def execute_file(fileName):
    #cwd = find_cwd()
    folderPath = cwd
    os.chdir(folderPath)
    subprocess.run(args=[fileName], shell=True)
    #subprocess.run(args=['start','excel',fileName], shell=True)
    

fileName = make_resultHTMLname(contents,cwd)
#fileName = "Test1.html"

#execute_file(fileName)


# Assign your output to the OUT variable.
OUT = fileName
# ----------------------------------------
start_webserver = Python(IN[0]=htmlPath, IN[1]=n0_set_port_number_기본값_8000_작동_오류)  # CPython3
# ---------- start_webserver.python (48 lines) ----------
# Load the Python Standard and DesignScript Libraries
import sys
import clr
clr.AddReference('ProtoGeometry')
from Autodesk.DesignScript.Geometry import *

import os
import asyncio
import multiprocessing
import subprocess
# The inputs to this node will be stored as a list in the IN variables.
dataEnteringNode = IN
cwd = IN[0]
portNo = IN[1]
# Place your code below this line
batStr = f"""
@echo on
python -m http.server {portNo}
cmd /k
"""
##cmd /k
title = "localWebserver"

def make_startSever_bat(batStr,title,cwd):
    folderPath = cwd
    if not os.path.exists(folderPath):
        os.makedirs(folderPath)
    fileName = f"{title}.bat"
    filePath = f"{folderPath}\\" + fileName
    f = open(filePath, 'w', encoding='utf8')
    f.write(batStr)
    f.close()
    return fileName

def startBat(fileName, cwd):
    cmdStr = f".\\{fileName}"
    cmdList= cmdStr.split(' ')
    os.chdir(cwd)
    
    res = subprocess.Popen(args=cmdList, shell=True)
    return res

batFileName = make_startSever_bat(batStr,title,cwd)
#res = multiprocessing.Process(name="SubProcess", target=startBat, args=(batFileName, cwd))
# Assign your output to the OUT variable.
OUT = startBat(batFileName, cwd)

#startBat(fileName, cwd)
# ----------------------------------------
make_htmlStr_2 = Python(IN[0]=javascriptPart, IN[1]=cssPart)  # CPython3; unwired: IN[2]
# ---------- make_htmlStr_2.python (53 lines) ----------
# Load the Python Standard and DesignScript Libraries
import sys
import clr
clr.AddReference('ProtoGeometry')
from Autodesk.DesignScript.Geometry import *

# The inputs to this node will be stored as a list in the IN variables.
dataEnteringNode = IN
jsPart = IN[0]
cssPart = IN[1]
tablePart = IN[2]

# Place your code below this line
##folderPath_r = folderPath.replace('\\','\\\\')

htmlStr = f'''
<!DOCTYPE html>
<html lang="ko">

<head>
    <meta charset="UTF-8">
    <title>my first three.js app</title>
    <style>
        {cssPart}
    </style>
</head>

<body>


<div class="wrapper">

  <a data-fslightbox="gallery" href="#custom-source">
    유튜브 라이트박스
  </a>

  <iframe id="custom-source"
          frameborder="0"
          width="1920px"
          height="1080px"
          allow="autoplay; fullscreen"
          src="https://www.youtube.com/embed/qgBSiRwsbNw?autoplay=1">
  </iframe>
</div>

<script src="https://cdnjs.cloudflare.com/ajax/libs/fslightbox/3.3.1/index.min.js" integrity="sha512-EqNNJuepkw5P9vxCml8eBk7C4Ld+4kAnvzOD/jG21rkxWPILGoQa5EvD62UieiJF0u3xoQrcVnce4i83VnYj/Q==" crossorigin="anonymous" referrerpolicy="no-referrer"></script>

</body>

</html>
'''
# Assign your output to the OUT variable.
OUT = htmlStr
# ----------------------------------------

# group: Excavation Target Select 뷰로 이동
n0_1_실행모드_선택_확인_필수 = CustomSelection("A. 토공참조선작성모드", items={A. 토공참조선작성모드: "토공참조선작성모드", B. 물량산출모드: "물량산출모드", * 토공객체삭제모드: "토공객체삭제모드"}, IsVisibleDropDownTextBlock=true)  # "▶ [0.1] 실행모드 선택 - 확인 필수!"; graph input
code_block_2 = CodeBlock { "3D_AR_for Earth Calc"; }  # frozen
earth_view_열기 = Python(IN[0]=code_block_2)  # CPython3
# ---------- earth_view_열기.python (41 lines) ----------
# Import required Revit API and services
import clr
clr.AddReference("RevitAPI")
clr.AddReference("RevitServices")
clr.AddReference("RevitNodes")

from Autodesk.Revit.DB import *
from RevitServices.Persistence import DocumentManager
from RevitServices.Transactions import TransactionManager

# Get the active document and UIDocument
uiapp = DocumentManager.Instance.CurrentUIApplication
uidoc = uiapp.ActiveUIDocument
doc = DocumentManager.Instance.CurrentDBDocument

# Input: View name from Dynamo
view_name = IN[0]  # View name (string) to open

# Find the view by name
views = FilteredElementCollector(doc).OfClass(View).ToElements()
target_view = None

for view in views:
    if view.Name == view_name and not view.IsTemplate:  # Ignore view templates
        target_view = view
        break

# Open the view if it exists

if target_view:
    # Start a transaction
    TransactionManager.Instance.EnsureInTransaction(doc)
    
    uidoc.RequestViewChange(target_view)  # Opens the target view
    
    # Complete the transaction    
    TransactionManager.Instance.TransactionTaskDone()
    OUT = "View opened: {}".format(view_name)

else:
    OUT = "View not found: {}".format(view_name)
# ----------------------------------------
n0_0_안내문_영역_입력_불필요 = StringInput("""본 토공 물량 산출기는
터파기하단선 작성 → 형상 및 물량 산출의 순서로 이루어집니다.
아래 [0.1] 항목에서
"A 모드 선택 후 실행 → B 모드 선택 후 실행"의 순서로 이용십시오.""")  # "⏸ [0.0]안내문 영역 // 입력 불필요 //"; graph input

a_2_토공참조선_선택_대상들을_그룹으로_적용하시겠습니까 = CustomSelection("그룹모드", items={그룹모드: "그룹모드", 개별모드: "개별모드"}, IsVisibleDropDownTextBlock=true)  # "▶ [A.2] 토공참조선 선택 대상들을 그룹으로 적용하시겠습니까? 개별로 적용하시겠습니까?"; graph input
a_1_토공참조선을_생성할_대상_선택_드래그만_가능 = DSModelElementsSelection()  # 167 picked in the model; graph input
filter_line_etc = Python(IN[0]=a_1_토공참조선을_생성할_대상_선택_드래그만_가능)  # CPython3
# ---------- filter_line_etc.python (96 lines) ----------
# Load the Python Standard and DesignScript Libraries
import sys
import clr
clr.AddReference('ProtoGeometry')
from Autodesk.DesignScript.Geometry import *

import Revit
clr.ImportExtensions(Revit.Elements)
clr.ImportExtensions(Revit.GeometryConversion)

################Module For Functional Programing#########################
from functools import reduce
from itertools import chain
from itertools import groupby
from copy import deepcopy

curry = lambda f: lambda a, *args: (
    f(a, *args) if (len(args)) else lambda *args: f(a, *args)
)

filter, map, reduce = curry(filter), curry(map), curry(reduce)

go = lambda *args: reduce(lambda a, f: f(a), args)  ## 함수도 축약 가능 ##


def dictUpdate(dic1, dic2):
    dic1.update(dic2)
    return dic1


def dictsMerge(dics):
    res = reduce(dictUpdate, dics)
    return res


def dictDeleteKeys(dic, keys):
    for k in keys:
        del dic[k]
    return dic


def update_nested_dict(dictionary, keys, value):
    current_dict = dictionary
    for key in keys[:-1]:
        current_dict = current_dict.setdefault(key, {})
    current_dict[keys[-1]] = value


def flat(a):
    if isinstance(a, list):
        for i in a:
            yield from flat(i)
    else:
        yield a


def grpBy(iter, key):
    f, grpKeys, grps = key, [], []
    sorted_ = sorted(iter, key=f)
    for key, grp_data in groupby(sorted_, key=f):
        grpKeys.append(key)
        grps.append(list(grp_data))
    return grps, grpKeys


#########################################################################

# The inputs to this node will be stored as a list in the IN variables.
dataEnteringNode = IN
elems = IN[0]
# Place your code below this line
res = go(
    elems,
    filter( lambda x: "Point" not in str(x.GetParameterValueByName("Category")) ),
    filter( lambda x: "Lines" not in str(x.GetParameterValueByName("Category")) ),
    filter( lambda x: "Railings" not in str(x.GetParameterValueByName("Category")) ),
    filter( lambda x: "Doors" not in str(x.GetParameterValueByName("Category")) ),
    filter( lambda x: "Windows" not in str(x.GetParameterValueByName("Category")) ),
    filter( lambda x: "Curtain Wall" not in str(x.GetParameterValueByName("Category")) ),
    filter( lambda x: "Line" not in str(x.GetParameterValueByName("Family and Type")) ),
    filter( lambda x: "line" not in str(x.GetParameterValueByName("Family and Type")) ),
    filter( lambda x: "Point" not in str(x.GetParameterValueByName("Family and Type")) ),
    filter( lambda x: "point" not in str(x.GetParameterValueByName("Family and Type")) ),
    filter( lambda x: "_Pile_" not in str(x.GetParameterValueByName("Family and Type")) ),
    filter( lambda x: "_pile_" not in str(x.GetParameterValueByName("Family and Type")) ),
    filter( lambda x: "_lean_" not in str(x.GetParameterValueByName("Family and Type")) ),
    filter( lambda x: "_Lean_" not in str(x.GetParameterValueByName("Family and Type")) ),
    filter( lambda x: "_Splash Block" not in str(x.GetParameterValueByName("Family and Type")) ),
    filter( lambda x: "_Splash block" not in str(x.GetParameterValueByName("Family and Type")) ),
    filter( lambda x: "_splash block" not in str(x.GetParameterValueByName("Family and Type")) ),
    filter( lambda x: "Stairs" not in str(x.GetParameterValueByName("Family and Type")) ),
    filter( lambda x: "Void" not in str(x.GetParameterValueByName("Family and Type")) ),
    filter( lambda x: "void" not in str(x.GetParameterValueByName("Family and Type")) ),
)
# Assign your output to the OUT variable.
OUT = res
# ----------------------------------------
filter_etc = Python(IN[0]=filter_line_etc)  # CPython3
# ---------- filter_etc.python (81 lines) ----------
# Load the Python Standard and DesignScript Libraries
import sys
import clr
clr.AddReference('ProtoGeometry')
from Autodesk.DesignScript.Geometry import *

import Revit
clr.ImportExtensions(Revit.Elements)
clr.ImportExtensions(Revit.GeometryConversion)

################Module For Functional Programing#########################
from functools import reduce
from itertools import chain
from itertools import groupby
from copy import deepcopy

curry = lambda f: lambda a, *args: (
    f(a, *args) if (len(args)) else lambda *args: f(a, *args)
)

filter, map, reduce = curry(filter), curry(map), curry(reduce)

go = lambda *args: reduce(lambda a, f: f(a), args)  ## 함수도 축약 가능 ##


def dictUpdate(dic1, dic2):
    dic1.update(dic2)
    return dic1


def dictsMerge(dics):
    res = reduce(dictUpdate, dics)
    return res


def dictDeleteKeys(dic, keys):
    for k in keys:
        del dic[k]
    return dic


def update_nested_dict(dictionary, keys, value):
    current_dict = dictionary
    for key in keys[:-1]:
        current_dict = current_dict.setdefault(key, {})
    current_dict[keys[-1]] = value


def flat(a):
    if isinstance(a, list):
        for i in a:
            yield from flat(i)
    else:
        yield a


def grpBy(iter, key):
    f, grpKeys, grps = key, [], []
    sorted_ = sorted(iter, key=f)
    for key, grp_data in groupby(sorted_, key=f):
        grpKeys.append(key)
        grps.append(list(grp_data))
    return grps, grpKeys


#########################################################################

# The inputs to this node will be stored as a list in the IN variables.
dataEnteringNode = IN
elems = IN[0]
# Place your code below this line
res = go(
    elems,
    filter( lambda x: "_Ground Insulation" not in str(x.GetParameterValueByName("Family and Type")) ),
    filter( lambda x: "Slab Edge" not in str(x.GetParameterValueByName("Category")) ),
    filter( lambda x: "Wall" not in str(x.GetParameterValueByName("Category")) ),
    filter( lambda x: "Edge" not in str(x.GetParameterValueByName("Family and Type")) ),
    filter( lambda x: "_Lean_" not in str(x.GetParameterValueByName("Family and Type")) ),
)
# Assign your output to the OUT variable.
OUT = res
# ----------------------------------------

# group: 공통정보 입력
a_3_터파기_관련_공통정보_입력_항목순서_변경_삭제_금지 = StringInput("""------------------------
<< Lean 두께 (m) >>
C1 : 0.05
------------------------
<< Base 두께 (m) >>
C2 : 0.1
------------------------
<< SubBase 두께 (m) >>
C3 : 0.1
------------------------
<< Extra Excavation 두께 (m) >>
C4 : 0
------------------------
<< Lean 돌출길이 (m) >>
D1 : 0.1
------------------------
<< 터파기 여유폭 (m) >>
D2 : 0.2
------------------------""")  # graph input
공통정보_입력_파싱 = Python(IN[0]=a_3_터파기_관련_공통정보_입력_항목순서_변경_삭제_금지)  # CPython3
# ---------- 공통정보_입력_파싱.python (85 lines) ----------
# Load the Python Standard and DesignScript Libraries
import sys
import clr
clr.AddReference('ProtoGeometry')
from Autodesk.DesignScript.Geometry import *

################Module For Functional Programing#########################
from functools import reduce
from itertools import chain
from itertools import groupby
from copy import deepcopy

curry = lambda f: lambda a, *args: (
    f(a, *args) if (len(args)) else lambda *args: f(a, *args)
)

filter, map, reduce = curry(filter), curry(map), curry(reduce)

go = lambda *args: reduce(lambda a, f: f(a), args)  ## 함수도 축약 가능 ##


def dictUpdate(dic1, dic2):
    dic1.update(dic2)
    return dic1


def dictsMerge(dics):
    res = reduce(dictUpdate, dics)
    return res


def dictDeleteKeys(dic, keys):
    for k in keys:
        del dic[k]
    return dic


def update_nested_dict(dictionary, keys, value):
    current_dict = dictionary
    for key in keys[:-1]:
        current_dict = current_dict.setdefault(key, {})
    current_dict[keys[-1]] = value


def flat(a):
    if isinstance(a, list):
        for i in a:
            yield from flat(i)
    else:
        yield a


def grpBy(iter, key):
    f, grpKeys, grps = key, [], []
    sorted_ = sorted(iter, key=f)
    for key, grp_data in groupby(sorted_, key=f):
        grpKeys.append(key)
        grps.append(list(grp_data))
    return grps, grpKeys


#########################################################################

# The inputs to this node will be stored as a list in the IN variables.
dataEnteringNode = IN
common_info_str = IN[0]
# Place your code below this line

def parse_commonInfo(common_info_str):
    res = common_info_str.split("\n")
    
    res = go(
        common_info_str,
        lambda x: x.split("\n"),
        map(lambda x: x.strip()),
        filter(lambda x: "---" not in x),
        filter(lambda x: "<" not in x),
        map(lambda x: x.split(":")),
        map(lambda x: float(x[-1])),
    )
    
    return res

# Assign your output to the OUT variable.
OUT = parse_commonInfo(common_info_str)
# ----------------------------------------
code_block_3 = CodeBlock(i=공통정보_입력_파싱) { i[0]; i[1]; i[2]; i[3]; i[4]; i[5]; }
b_1_토공_물량_관련_공통정보_입력_항목순서_변경_삭제 = StringInput("""------------------------
<< 토량환산계수 >>
VCF : 1.15
------------------------
<< 지하수위(m : GL 기준 음수) >>
GWL : -1
------------------------
<< 터파기각도 >
G : 1
------------------------""")  # "▶ [B.1] 토공 물량 관련 공통정보 입력 (항목순서 변경,삭제 금지)"; graph input
공통정보_입력_파싱_2 = Python(IN[0]=b_1_토공_물량_관련_공통정보_입력_항목순서_변경_삭제)  # CPython3; same code as 공통정보_입력_파싱
code_block_4 = CodeBlock(i=공통정보_입력_파싱_2) { i[0]; i[1]; i[2]; }

join = List.Join(list0=code_block_3.out0, list1=code_block_3.out1, list2=code_block_3.out2, list3=code_block_3.out3)
sum = Math.Sum(values=join)
code_block_5 = CodeBlock { 1000; }
mul = sum * code_block_5
code_block_6 = CodeBlock { -1; }
mul_2 = mul * code_block_6
join_2 = List.Join(list0=code_block_3.out4, list1=code_block_3.out5)
sum_2 = Math.Sum(values=join_2)
code_block_7 = CodeBlock { 1000; }
mul_3 = sum_2 * code_block_7
code_block_8 = CodeBlock(i=mul_3) { i; }
make_refLine_forExca_byMode = Python(IN[0]=n0_1_실행모드_선택_확인_필수, IN[1]=a_2_토공참조선_선택_대상들을_그룹으로_적용하시겠습니까, IN[2]=filter_etc, IN[3]=mul_2, IN[4]=code_block_8)  # CPython3
# ---------- make_refLine_forExca_byMode.python (190 lines) ----------
# Load the Python Standard and DesignScript Libraries
import sys
import clr
# Add Revit API references
clr.AddReference("RevitAPI")
clr.AddReference("RevitServices")
clr.AddReference('ProtoGeometry')
from Autodesk.DesignScript.Geometry import *
from Autodesk.Revit.DB import *
from RevitServices.Persistence import DocumentManager
from RevitServices.Transactions import TransactionManager


import Revit
clr.ImportExtensions(Revit.Elements)
clr.ImportExtensions(Revit.GeometryConversion)
# Document and UI setup
doc = DocumentManager.Instance.CurrentDBDocument
################Module For Functional Programing#########################
from functools import reduce
from itertools import chain
from itertools import groupby
from copy import deepcopy

curry = lambda f: lambda a, *args: (
    f(a, *args) if (len(args)) else lambda *args: f(a, *args)
)

filter, map, reduce = curry(filter), curry(map), curry(reduce)

go = lambda *args: reduce(lambda a, f: f(a), args)  ## 함수도 축약 가능 ##


def dictUpdate(dic1, dic2):
    dic1.update(dic2)
    return dic1


def dictsMerge(dics):
    res = reduce(dictUpdate, dics)
    return res


def dictDeleteKeys(dic, keys):
    for k in keys:
        del dic[k]
    return dic


def update_nested_dict(dictionary, keys, value):
    current_dict = dictionary
    for key in keys[:-1]:
        current_dict = current_dict.setdefault(key, {})
    current_dict[keys[-1]] = value


def flat(a):
    if isinstance(a, list):
        for i in a:
            yield from flat(i)
    else:
        yield a


def grpBy(iter, key):
    f, grpKeys, grps = key, [], []
    sorted_ = sorted(iter, key=f)
    for key, grp_data in groupby(sorted_, key=f):
        grpKeys.append(key)
        grps.append(list(grp_data))
    return grps, grpKeys


#########################################################################

def get_geom_elem(mode, elems):
    res = []
    tmp = []
    if refLine_mode=="그룹모드":
        for elem in elems:
            try:
                tmp.append(elem.Geometry()[0])
            except: pass
        res.append(tmp)
    if refLine_mode=="개별모드":
        for elem in elems:
            try:
                res.append(elem.Geometry())
            except: pass
    res_ = go(
        res,
        filter(lambda x: x ),
        list,
    )
    
    return res_
    
def get_btm_srf(geom):
    filter_rule = lambda srf: go(
        srf,
        lambda x: x.NormalAtParameter(0,0),
        lambda x: x.Z,
        lambda z: z==-1,
    )

    res = go(
        geom,
        lambda x: x.Explode(),
        filter( filter_rule ),
        list,
    )
    
    return res

#to convert point
def feet_to_m(a,b,c):
    k=0.3048
    return XYZ(a/k,b/k,c/k)

# The inputs to this node will be stored as a list in the IN variables.
dataEnteringNode = IN
exec_mode = IN[0]
refLine_mode = IN[1]
tgt_elems_ = IN[2]
tgt_elems = go(
    tgt_elems_,
    filter( lambda x: "Lean" not in str(x.GetParameterValueByName("Family and Type")) ),#.AsValueString() ),
    list,
)
descent_height = IN[3]
offset_gap = IN[4]

# Place your code below this line



def make_refLine_forExca(refLine_mode, tgt_elems, descent_height, offset_gap):
    all_geoms = get_geom_elem(refLine_mode, tgt_elems)
    bdCuboids = go(
        all_geoms,
        map( lambda x: BoundingBox.ByGeometry(list(x)) ),
        map( lambda x: x.ToCuboid() ),
    )
    btmSrfs = go(
        bdCuboids,
        map( get_btm_srf ),
        lambda x: chain(*x),list,
        map( lambda x: x.Translate(0,0,descent_height) ),
    )
    
    refLines = go(
        btmSrfs,
        map( lambda x: x.PerimeterCurves() ),
        map( lambda x: PolyCurve.ByJoinedCurves(x) ),
        map( lambda x: x.OffsetMany(
            signedDistance=offset_gap,
            extendCircular=False,
            planeNormal=None)
            ),
        lambda x: chain(*x),list,
        map( lambda x: x.Explode() ),
        list,
        #map( lambda x: ModelCurve. .GeometryCurve(x) ),
    )
    
    # Step 4: Start a transaction to create the ModelCurve
    TransactionManager.Instance.EnsureInTransaction(doc)
    
    # Create the ModelCurve in Revit
    res = []
    for refLine in refLines:
        tmp = []
        for line in refLine:
            try:
                model_curve = Revit.Elements.ModelCurve.ByCurve(line)
                tmp.append(model_curve)
            except:
                pass
        res.append(tmp)
    # Complete the transaction    
    TransactionManager.Instance.TransactionTaskDone()
    

    
    return refLines, res
# Assign your output to the OUT variable.
if exec_mode == "토공참조선작성모드":
    OUT = make_refLine_forExca(refLine_mode, tgt_elems, descent_height, offset_gap)
else:
    OUT = 0
# ----------------------------------------

# group: 모델라인만 검출
categories = Categories("OST_Lines")
all_elements_of_category = ElementsOfCategory(Category=categories)
code_block_9 = CodeBlock { "Detail Line"; }
getParameterValueByName = Element.GetParameterValueByName(element=all_elements_of_category, parameterName=code_block_9)
code_block_10 = CodeBlock(i=getParameterValueByName) { i==0?true:false; }
filterByBoolMask = List.FilterByBoolMask(list=all_elements_of_category, mask=code_block_10)

parameters = Element.Parameters(element=all_elements_of_category)
code_block_11 = CodeBlock(exec_mode=n0_1_실행모드_선택_확인_필수) { exec_mode; }
code_block_12 = CodeBlock(exec_mode=code_block_11) { exec_mode; }

# group: All Elements in Revit
all_elementsexceptrails = Python(IN[0]=code_block_12)  # CPython3
# ---------- all_elementsexceptrails.python (262 lines) ----------
# Load the Python Standard and DesignScript Libraries
import sys
import clr
clr.AddReference('ProtoGeometry')
from Autodesk.DesignScript.Geometry import *

clr.AddReference("RevitNodes")
import Revit
clr.ImportExtensions(Revit.Elements)
#clr.AddReference("Revit.GeometryConversion")
clr.ImportExtensions(Revit.GeometryConversion)
#import Revit.GeometryConversion #import ProtoToRevit, RevitToProto
#from Revit import GeometryConversion

clr.AddReference('RevitAPI')
from Autodesk.Revit.DB import *
import Autodesk

clr.AddReference('RevitServices')
import RevitServices
from RevitServices.Persistence import DocumentManager
doc = DocumentManager.Instance.CurrentDBDocument


################Module For Functional Programing#########################
from functools import reduce
from itertools import chain
from itertools import groupby
from copy import deepcopy

curry = lambda f: lambda a, *args: (
    f(a, *args) if (len(args)) else lambda *args: f(a, *args)
)

filter, map, reduce = curry(filter), curry(map), curry(reduce)

go = lambda *args: reduce(lambda a, f: f(a), args)  ## 함수도 축약 가능 ##


def dictUpdate(dic1, dic2):
    dic1.update(dic2)
    return dic1


def dictsMerge(dics):
    res = reduce(dictUpdate, dics)
    return res


def dictDeleteKeys(dic, keys):
    for k in keys:
        del dic[k]
    return dic


def update_nested_dict(dictionary, keys, value):
    current_dict = dictionary
    for key in keys[:-1]:
        current_dict = current_dict.setdefault(key, {})
    current_dict[keys[-1]] = value


def flat(a):
    if isinstance(a, list):
        for i in a:
            yield from flat(i)
    else:
        yield a


def grpBy(iter, key):
    f, grpKeys, grps = key, [], []
    sorted_ = sorted(iter, key=f)
    for key, grp_data in groupby(sorted_, key=f):
        grpKeys.append(key)
        grps.append(list(grp_data))
    return grps, grpKeys


# The inputs to this node will be stored as a list in the IN variables.
dataEnteringNode = IN
exec_mode = IN[0]


#########################################################################
def get_QGeometry(elem):
    # Revit Document 객체 가져오기
    doc = DocumentManager.Instance.CurrentDBDocument
    revitElement = UnwrapElement(elem)
    
    # Geometry 가져오기 옵션 설정
    geometryOptions = Options()
    geometryOptions.DetailLevel = ViewDetailLevel.Fine  # 세부 레벨 설정 (Fine, Medium, Coarse 등)
    geometryOptions.IncludeNonVisibleObjects = True    # 비가시 기하학 포함 여부
    
    # GeometryElement 가져오기
    #geometryElement = revitElement.get_Geometry(geometryOptions).ToProtoType()
    geometryElement = revitElement.get_Geometry(geometryOptions).ToProtoType()

    # Geometry 변환 리스트 초기화
    dynamoGeometries = []

    # GeometryElement 내의 GeometryObject 순회
    for geomObj in geometryElement:
        # Revit GeometryObject를 Dynamo Geometry로 변환
        dynGeom = geomObj#.ToProtoType()
        #dynGeom = Revit.GeometryConversion.RevitToProtoSolid.ToProtoType(geomObj)
        if dynGeom:
            dynamoGeometries.append(dynGeom)
    
    return dynamoGeometries

def get_all_BIC():

    db = [
    #Autodesk.Revit.DB.BuiltInCategory.OST_Rooms,
    Autodesk.Revit.DB.BuiltInCategory.OST_Floors,
    Autodesk.Revit.DB.BuiltInCategory.OST_EdgeSlab,
    #Autodesk.Revit.DB.BuiltInCategory.OST_Roofs,
    #Autodesk.Revit.DB.BuiltInCategory.OST_Walls,
    Autodesk.Revit.DB.BuiltInCategory.OST_StructuralFoundation,
    #Autodesk.Revit.DB.BuiltInCategory.OST_StructuralColumns,
    #Autodesk.Revit.DB.BuiltInCategory.OST_StructuralFraming,
    
    #Autodesk.Revit.DB.BuiltInCategory.OST_Ceilings,
    #Autodesk.Revit.DB.BuiltInCategory.OST_Doors,
    #Autodesk.Revit.DB.BuiltInCategory.OST_Windows,
    #Autodesk.Revit.DB.BuiltInCategory.OST_Stairs,
    #Autodesk.Revit.DB.BuiltInCategory.OST_GenericModel,
    ]
    return db
    
def get_allElems(doc):
    bics = get_all_BIC()
    
    def get_elems(x):
        collector = FilteredElementCollector(doc)
        res = collector.OfCategory(x).WhereElementIsNotElementType().ToElements()
        return res

    def get_ug_elems(x):
        collector = FilteredElementCollector(doc)
        allElems = collector.OfCategory(x).WhereElementIsNotElementType().ToElements()
        res = go(
            allElems,
            filter( lambda x: "UG" in x.LookupParameter("Family and Type").AsValueString() ),
            list,
        )
        return res

    def get_ug_cols():
        x = Autodesk.Revit.DB.BuiltInCategory.OST_StructuralColumns
        collector = FilteredElementCollector(doc)
        allElems = collector.OfCategory(x).WhereElementIsNotElementType().ToElements()
        res = go(
            allElems,
            filter( lambda x: "UG" in x.LookupParameter("Family and Type").AsValueString() ),
            list,
        )
        return res
        
    def get_ug_frames():
        x = Autodesk.Revit.DB.BuiltInCategory.OST_StructuralFraming
        collector = FilteredElementCollector(doc)
        allElems = collector.OfCategory(x).WhereElementIsNotElementType().ToElements()
        res = go(
            allElems,
            filter( lambda x: "UG" in x.LookupParameter("Family and Type").AsValueString() ),
            list,
        )
        return res

    def get_railElems(x):
        collector = FilteredElementCollector(doc)
        res = collector.OfCategory(x).WhereElementIsNotElementType().ToElements()
        return res
        
    def get_genericModels():
        x = Autodesk.Revit.DB.BuiltInCategory.OST_GenericModel
        collector = FilteredElementCollector(doc)
        allElems = collector.OfCategory(x).WhereElementIsNotElementType().ToElements()
        res = go(
            allElems,
            #filter( lambda x: DSCore.Object.Type(x)!="Revit.Elements.DirectShape" ),
            filter( lambda x: type(x)!="Revit.Elements.DirectShape" ),
            list,
        )
        return res

    pre_res = go(
        list(chain(*map(get_elems, bics))),
        filter( lambda x: "Lean" not in x.LookupParameter("Family and Type").AsValueString() ),
        list,
    )

    res = [
        get_elems(Autodesk.Revit.DB.BuiltInCategory.OST_Rooms),
        get_elems(Autodesk.Revit.DB.BuiltInCategory.OST_StructuralColumns),
        get_elems(Autodesk.Revit.DB.BuiltInCategory.OST_StructuralFraming),
        get_ug_elems(Autodesk.Revit.DB.BuiltInCategory.OST_Walls),
        #get_elems(Autodesk.Revit.DB.BuiltInCategory.OST_EdgeSlab),
        get_elems(Autodesk.Revit.DB.BuiltInCategory.OST_Floors),
        get_elems(Autodesk.Revit.DB.BuiltInCategory.OST_StructuralFoundation),
        #list(map(get_elems, bics))# + get_genericModels()
        pre_res,
    ]

    return res

def get_solid(element):
    geos = []
    for geo in element.get_Geometry(Options()):
        geos.append(geo)
    
    #res = Revit.GeometryConversion.RevitToProtoSolid.ToProtoType(geos[0])
    
    return geos[0]


def union_solids(solids):
    """
    주어진 Solid 객체 리스트를 유니온하여 하나의 Solid로 반환
    :param solids: List[Solid]
    :return: Solid
    """
    if not solids or len(solids) < 2:
        raise ValueError("유니온을 수행할 최소 2개의 Solid가 필요합니다.")
    
    # 첫 번째 Solid를 기준으로 시작
    result = solids[0]
    
    # 남은 Solid와 반복적으로 유니온 수행
    for solid in solids[1:]:
        if solid.Volume > 0:  # Solid가 비어 있지 않은지 확인
            result = BooleanOperationsUtils.ExecuteBooleanOperation(result, solid, BooleanOperationsType.Union)
    
    return result

def get_allElems_unionSolid(allElems):
    allRooms = get_allElems(doc)[0]
    allElems = list(chain(*get_allElems(doc)[1]))
    res = go(
        allElems,
        #map(lambda x: dir(x)),
        map( lambda x: get_solid(x) ),
        list,
        #map(lambda x: get_QGeometry(x)),
#        lambda x: chain(*x),
        lambda x: Solid_ByUnion(x),
    )
    return res
    

# Place your code below this line



# Assign your output to the OUT variable.
if exec_mode == "물량산출모드":
    OUT = get_allElems(doc)
else:
    OUT = [[]]
# ----------------------------------------

flatten = List.Flatten(list=all_elementsexceptrails)
filter_line_etc_2 = Python(IN[0]=flatten)  # CPython3
# ---------- filter_line_etc_2.python (93 lines) ----------
# Load the Python Standard and DesignScript Libraries
import sys
import clr
clr.AddReference('ProtoGeometry')
from Autodesk.DesignScript.Geometry import *

import Revit
clr.ImportExtensions(Revit.Elements)
clr.ImportExtensions(Revit.GeometryConversion)

################Module For Functional Programing#########################
from functools import reduce
from itertools import chain
from itertools import groupby
from copy import deepcopy

curry = lambda f: lambda a, *args: (
    f(a, *args) if (len(args)) else lambda *args: f(a, *args)
)

filter, map, reduce = curry(filter), curry(map), curry(reduce)

go = lambda *args: reduce(lambda a, f: f(a), args)  ## 함수도 축약 가능 ##


def dictUpdate(dic1, dic2):
    dic1.update(dic2)
    return dic1


def dictsMerge(dics):
    res = reduce(dictUpdate, dics)
    return res


def dictDeleteKeys(dic, keys):
    for k in keys:
        del dic[k]
    return dic


def update_nested_dict(dictionary, keys, value):
    current_dict = dictionary
    for key in keys[:-1]:
        current_dict = current_dict.setdefault(key, {})
    current_dict[keys[-1]] = value


def flat(a):
    if isinstance(a, list):
        for i in a:
            yield from flat(i)
    else:
        yield a


def grpBy(iter, key):
    f, grpKeys, grps = key, [], []
    sorted_ = sorted(iter, key=f)
    for key, grp_data in groupby(sorted_, key=f):
        grpKeys.append(key)
        grps.append(list(grp_data))
    return grps, grpKeys


#########################################################################

# The inputs to this node will be stored as a list in the IN variables.
dataEnteringNode = IN
elems = IN[0]
# Place your code below this line
res = go(
    elems,
    filter( lambda x: "Point" not in str(x.GetParameterValueByName("Category")) ),
    filter( lambda x: "Lines" not in str(x.GetParameterValueByName("Category")) ),
    filter( lambda x: "Railings" not in str(x.GetParameterValueByName("Category")) ),
    filter( lambda x: "Doors" not in str(x.GetParameterValueByName("Category")) ),
    filter( lambda x: "Windows" not in str(x.GetParameterValueByName("Category")) ),
    filter( lambda x: "Curtain Wall" not in str(x.GetParameterValueByName("Category")) ),
    filter( lambda x: "Line" not in str(x.GetParameterValueByName("Family and Type")) ),
    filter( lambda x: "line" not in str(x.GetParameterValueByName("Family and Type")) ),
    filter( lambda x: "Point" not in str(x.GetParameterValueByName("Family and Type")) ),
    filter( lambda x: "point" not in str(x.GetParameterValueByName("Family and Type")) ),
    filter( lambda x: "_Pile_" not in str(x.GetParameterValueByName("Family and Type")) ),
    filter( lambda x: "_pile_" not in str(x.GetParameterValueByName("Family and Type")) ),
    filter( lambda x: "_lean_" not in str(x.GetParameterValueByName("Family and Type")) ),
    filter( lambda x: "_Lean_" not in str(x.GetParameterValueByName("Family and Type")) ),
    filter( lambda x: "_Splash Block" not in str(x.GetParameterValueByName("Family and Type")) ),
    filter( lambda x: "_Splash block" not in str(x.GetParameterValueByName("Family and Type")) ),
    filter( lambda x: "_splash block" not in str(x.GetParameterValueByName("Family and Type")) ),
)
# Assign your output to the OUT variable.
OUT = res
# ----------------------------------------
filter_lean_pile_etc = Python(IN[0]=filter_line_etc_2)  # CPython3
# ---------- filter_lean_pile_etc.python (86 lines) ----------
# Load the Python Standard and DesignScript Libraries
import sys
import clr
clr.AddReference('ProtoGeometry')
from Autodesk.DesignScript.Geometry import *

import Revit
clr.ImportExtensions(Revit.Elements)
clr.ImportExtensions(Revit.GeometryConversion)

################Module For Functional Programing#########################
from functools import reduce
from itertools import chain
from itertools import groupby
from copy import deepcopy

curry = lambda f: lambda a, *args: (
    f(a, *args) if (len(args)) else lambda *args: f(a, *args)
)

filter, map, reduce = curry(filter), curry(map), curry(reduce)

go = lambda *args: reduce(lambda a, f: f(a), args)  ## 함수도 축약 가능 ##


def dictUpdate(dic1, dic2):
    dic1.update(dic2)
    return dic1


def dictsMerge(dics):
    res = reduce(dictUpdate, dics)
    return res


def dictDeleteKeys(dic, keys):
    for k in keys:
        del dic[k]
    return dic


def update_nested_dict(dictionary, keys, value):
    current_dict = dictionary
    for key in keys[:-1]:
        current_dict = current_dict.setdefault(key, {})
    current_dict[keys[-1]] = value


def flat(a):
    if isinstance(a, list):
        for i in a:
            yield from flat(i)
    else:
        yield a


def grpBy(iter, key):
    f, grpKeys, grps = key, [], []
    sorted_ = sorted(iter, key=f)
    for key, grp_data in groupby(sorted_, key=f):
        grpKeys.append(key)
        grps.append(list(grp_data))
    return grps, grpKeys


#########################################################################

# The inputs to this node will be stored as a list in the IN variables.
dataEnteringNode = IN
elems = IN[0]
# Place your code below this line


res = go(
    elems,
    #lambda x: list(chain(*x)),
    filter( lambda x: "_Pile_" not in str(x.GetParameterValueByName("Family and Type")) ),
    filter( lambda x: "_pile_" not in str(x.GetParameterValueByName("Family and Type")) ),
    filter( lambda x: "Pile_" not in str(x.GetParameterValueByName("Family and Type")) ),
    filter( lambda x: "pile_" not in str(x.GetParameterValueByName("Family and Type")) ),
    filter( lambda x: "_Pile" not in str(x.GetParameterValueByName("Family and Type")) ),
    filter( lambda x: "_pile" not in str(x.GetParameterValueByName("Family and Type")) ),
)

# Assign your output to the OUT variable.
OUT = res
# ----------------------------------------
flatten_2 = List.Flatten(list=filter_lean_pile_etc)
parameters_2 = Element.Parameters(element=flatten_2)
n1_a_3_터파기_관련_공통정보_입력 = StringInput("""------------------------
<< Lean 두께 (m) >>
C1 : 0.05
------------------------
<< Base 두께 (m) >>
C2 : 0.1
------------------------
<< SubBase 두께 (m) >>
C3 : 0.1
------------------------
<< Extra Excavation 두께 (m) >>
C4 : 0
------------------------
<< Lean 돌출길이 (m) >>
D1 : 0.1
------------------------
<< 터파기 여유폭 (m) >>
D2 : 0.2
------------------------""")  # "[1.A.3] 터파기 관련 공통정보 입력"; frozen
n1_b_1_토공_물량_관련_공통정보_입력 = StringInput("""------------------------
<< 토량환산계수 >>
VCF : 1.15
------------------------
<< 지하수위(GL 기준 음수) >>
GWL : -1
------------------------
<< 터파기각도 >
G : 1
------------------------""")  # "[1.B.1] 토공 물량 관련 공통정보 입력"; frozen
n0_2_gl_레벨_선택 = Levels("H.P.P")  # "▶ [0.2] GL 레벨 선택"; graph input
elevation = Level.Elevation(level=n0_2_gl_레벨_선택)
basePoint = Coordinates.BasePoint()
code_block_13 = CodeBlock(BP=basePoint) { BP.Z; }
GL_elevation_decide = Python(IN[0]=elevation, IN[1]=code_block_13)  # CPython3; unwired: IN[2]
# ---------- GL_elevation_decide.python (19 lines) ----------
# Load the Python Standard and DesignScript Libraries
import sys
import clr
clr.AddReference('ProtoGeometry')
from Autodesk.DesignScript.Geometry import *

# The inputs to this node will be stored as a list in the IN variables.
dataEnteringNode = IN
GL_elevation_prime = IN[0]
pjtBasePointZ = IN[1]
# Place your code below this line

if abs(GL_elevation_prime - pjtBasePointZ) < 100:
    res = GL_elevation_prime
else:
    res = GL_elevation_prime + pjtBasePointZ

# Assign your output to the OUT variable.
OUT = res
# ----------------------------------------
surveyPoint = Coordinates.SurveyPoint()
code_block_14 = CodeBlock(SP=surveyPoint) { SP.Z; }
gl_높이_오류시_true로_변경 = BoolSelector(false)  # graph input
survey_point_보정 = Python(IN[0]=GL_elevation_decide, IN[1]=code_block_14, IN[2]=elevation, IN[3]=gl_높이_오류시_true로_변경)  # CPython3
# ---------- survey_point_보정.python (31 lines) ----------
# Load the Python Standard and DesignScript Libraries
import sys
import clr
clr.AddReference('ProtoGeometry')
from Autodesk.DesignScript.Geometry import *

# The inputs to this node will be stored as a list in the IN variables.
dataEnteringNode = IN
GL_elev = IN[0]
sp_Z = IN[1]
GL_raw_elev = IN[2]
err_bln = IN[3]
# Place your code below this line
def closer_to_zero(a, b, GL_raw_elev, err_bln):
    # 절댓값이 작은 값이 0에 더 가까움
    # 같을 경우 더 큰 값을 선택하고 싶다면 조건 추가 가능
    if err_bln:
        return GL_raw_elev
    elif abs(a) < abs(b):
        return a
    elif abs(a) > abs(b):
        return b
    else:
        # 절댓값이 같다면 양수를 우선 (원하는 기준에 따라 조정 가능)
        return max(a, b)

GL_elev_modifiedBy_spZ = GL_elev + sp_Z
res = closer_to_zero(GL_elev, GL_elev_modifiedBy_spZ, GL_raw_elev, err_bln)

# Assign your output to the OUT variable.
OUT = res
# ----------------------------------------
code_block_15 = CodeBlock(socket=survey_point_보정)
# ---------- code_block_15.designscript (2 lines) ----------
socket;
//+ sp_Z;
# ----------------------------------------
code_block_16 = CodeBlock(gl_elev=code_block_15) { gl_elev; }
getGeoms = Python(IN[0]=flatten_2, IN[1]=code_block_16)  # CPython3
# ---------- getGeoms.python (95 lines) ----------
# Load the Python Standard and DesignScript Libraries
import sys
import clr
clr.AddReference('ProtoGeometry')
from Autodesk.DesignScript.Geometry import *

################Module For Functional Programing#########################
from functools import reduce
from itertools import chain
from itertools import groupby
from copy import deepcopy

curry = lambda f: lambda a, *args: (
    f(a, *args) if (len(args)) else lambda *args: f(a, *args)
)

filter, map, reduce = curry(filter), curry(map), curry(reduce)

go = lambda *args: reduce(lambda a, f: f(a), args)  ## 함수도 축약 가능 ##


def dictUpdate(dic1, dic2):
    dic1.update(dic2)
    return dic1


def dictsMerge(dics):
    res = reduce(dictUpdate, dics)
    return res


def dictDeleteKeys(dic, keys):
    for k in keys:
        del dic[k]
    return dic


def update_nested_dict(dictionary, keys, value):
    current_dict = dictionary
    for key in keys[:-1]:
        current_dict = current_dict.setdefault(key, {})
    current_dict[keys[-1]] = value


def flat(a):
    if isinstance(a, list):
        for i in a:
            yield from flat(i)
    else:
        yield a


def grpBy(iter, key):
    f, grpKeys, grps = key, [], []
    sorted_ = sorted(iter, key=f)
    for key, grp_data in groupby(sorted_, key=f):
        grpKeys.append(key)
        grps.append(list(grp_data))
    return grps, grpKeys


#########################################################################
# The inputs to this node will be stored as a list in the IN variables.
dataEnteringNode = IN
allElems = IN[0]
gl_elev = IN[1]
# Place your code below this line

def getGeoms(elems):
    res = []
    for elem in elems:
        try:
            res.append( elem.Geometry() )
        except:
            pass
    return res

allGeoms = list(chain(*getGeoms(allElems)))

get_bottom_elev = lambda geom: go(
    geom,
    lambda x: BoundingBox.ByGeometry(x).ToCuboid(),
    Geometry.Explode,
    filter( lambda x: x.NormalAtParameter(0.5,0.5).Z==-1 ),
    next,
    lambda x: x.PointAtParameter(0,0).Z ,
)

res = go(
    allGeoms,
    filter(lambda x: get_bottom_elev(x) < gl_elev ),
)

# Assign your output to the OUT variable.
OUT = res
# ----------------------------------------
isEmpty = List.IsEmpty(list=getGeoms)
byLengths = Cuboid.ByLengths()
list_create_2 = List.Create(item0=byLengths)
if_ = RefactoredIf(test=isEmpty, true=list_create_2, false=getGeoms)
byUnion = Solid.ByUnion(solids=if_)  # frozen
id = Element.Id(element=filterByBoolMask.in)
code_block_17 = CodeBlock { []; }
code_block_18 = CodeBlock(exec_mode=code_block_11) { exec_mode; }
group_closed_curves__function = Python()  # CPython3; unwired: IN[0]
# ---------- group_closed_curves__function.python (76 lines) ----------
import clr
import math
# Import Dynamo Geometry Library
clr.AddReference('ProtoGeometry')
from Autodesk.DesignScript.Geometry import Line, Point



def find_closed_loops_dynamo(lines):
    """Find closed loops from a list of Dynamo Line segments."""
    def is_close_dynamo(point1, point2, tolerance=1e-6):
        """Check if two Dynamo Points are close within a given tolerance."""
        return (
            math.isclose(point1.X, point2.X, abs_tol=tolerance) and
            math.isclose(point1.Y, point2.Y, abs_tol=tolerance) and
            math.isclose(point1.Z, point2.Z, abs_tol=tolerance)
        )
    
    closed_loops = []  # Stores completed closed loops
    source_list = lines.copy()  # Clone the source list to maintain original data


    while source_list:
        inspection_completed = []  # List to track inspected lines
        current_line = source_list.pop(0)  # Step 1: Select the first line
        inspection_completed.append(current_line)  # Add it to inspected list

        # Initialize start and end points
        start_point = current_line.StartPoint
        end_point = current_line.EndPoint

        while True:
            # Step 2: Find a line that connects to the last end point
            matching_line = None
            for line in source_list:
                if is_close_dynamo(line.StartPoint, end_point):
                    matching_line = line
                    new_start = line.StartPoint
                    new_end = line.EndPoint
                    break
                elif is_close_dynamo(line.EndPoint, end_point):
                    matching_line = line
                    new_start = line.EndPoint
                    new_end = line.StartPoint
                    break

            # If no matching line is found, break the loop
            if not matching_line:
                break

            # Update end point and add the matching line to inspected list
            end_point = new_end
            inspection_completed.append(matching_line)
            source_list.remove(matching_line)

            # Step 3: Check if the loop is closed
            if is_close_dynamo(start_point, end_point):
                # Step 4: Add inspection list as a closed loop
                closed_loops.append(inspection_completed)
                inspection_completed = []  # Reset for the next loop
                break

        # Step 6: If loop is incomplete, reset inspection list
        if inspection_completed:
            source_list.extend(inspection_completed)

    return closed_loops



# Find closed curves
#closed_groups = group_closed_curves(lines)

# Output: List of groups forming closed curves
#OUT = closed_groups
OUT = find_closed_loops_dynamo
# ----------------------------------------
getLocation = Element.GetLocation(element=filterByBoolMask.in)
code_block_19 = CodeBlock(VCF=code_block_4.out0) { VCF; }

# group: GWL 높이
code_block_20 = CodeBlock(i=code_block_4.out1) { i*1000; }
code_block_21 = CodeBlock(gl_elev=code_block_15) { gl_elev; }
add = code_block_20 + code_block_21

code_block_22 = CodeBlock(GWL=add) { GWL; }
code_block_23 = CodeBlock(G=code_block_4.out2) { G; }
code_block_24 = CodeBlock(gl_elev=code_block_15) { gl_elev; }
join_3 = List.Join(list0=code_block_19, list1=code_block_22, list2=code_block_23, list3=code_block_24)
code_block_25 = CodeBlock(comm_infos=join_3) { comm_infos; }
형상_바운딩화_옵션_b모드_에러시_true로_설정_요망 = BoolSelector(false)  # graph input
code_block_26 = CodeBlock(is_boundMode=형상_바운딩화_옵션_b모드_에러시_true로_설정_요망) { is_boundMode; }
code_block_27 = CodeBlock(is_boundMode=code_block_26) { is_boundMode; }
solidbyunion_예외처리 = Python(IN[0]=if_, IN[1]=code_block_27)  # CPython3
# ---------- solidbyunion_예외처리.python (105 lines) ----------
# Load the Python Standard and DesignScript Libraries
import sys
import clr
clr.AddReference('ProtoGeometry')
from Autodesk.DesignScript.Geometry import *

import Revit
clr.ImportExtensions(Revit.Elements)
clr.ImportExtensions(Revit.GeometryConversion)

################Module For Functional Programing#########################
from functools import reduce
from itertools import chain
from itertools import groupby
from copy import deepcopy

curry = lambda f: lambda a, *args: (
    f(a, *args) if (len(args)) else lambda *args: f(a, *args)
)

filter, map, reduce = curry(filter), curry(map), curry(reduce)

go = lambda *args: reduce(lambda a, f: f(a), args)  ## 함수도 축약 가능 ##


def dictUpdate(dic1, dic2):
    dic1.update(dic2)
    return dic1


def dictsMerge(dics):
    res = reduce(dictUpdate, dics)
    return res


def dictDeleteKeys(dic, keys):
    for k in keys:
        del dic[k]
    return dic


def update_nested_dict(dictionary, keys, value):
    current_dict = dictionary
    for key in keys[:-1]:
        current_dict = current_dict.setdefault(key, {})
    current_dict[keys[-1]] = value


def flat(a):
    if isinstance(a, list):
        for i in a:
            yield from flat(i)
    else:
        yield a


def grpBy(iter, key):
    f, grpKeys, grps = key, [], []
    sorted_ = sorted(iter, key=f)
    for key, grp_data in groupby(sorted_, key=f):
        grpKeys.append(key)
        grps.append(list(grp_data))
    return grps, grpKeys


#########################################################################

# The inputs to this node will be stored as a list in the IN variables.
dataEnteringNode = IN
solids = IN[0]
is_boundMode = IN[1]
# Place your code below this line




def union_solids(solids, is_boundMode):
    union_obj=None
    if is_boundMode:
        for idx, sol in enumerate(solids):
            if idx==0:
                union_obj = BoundingBox.ByGeometry(sol).ToCuboid()
            else:
                try:
                    bounding_sol = BoundingBox.ByGeometry(sol).ToCuboid()
                    union_obj = union_obj.Union(bounding_sol)
                except:
                    pass
    else:
        for idx, sol in enumerate(solids):
            if idx==0:
                union_obj = sol
            else:
                try:
                    union_obj = union_obj.Union(sol)
                except:
                    try:
                        bounding_sol = BoundingBox.ByGeometry(sol).ToCuboid()
                        union_obj = union_obj.Union(bounding_sol)
                    except:
                        pass
    return union_obj

# Assign your output to the OUT variable.
OUT = union_solids(solids, is_boundMode)
# ----------------------------------------
c1_c2_c3_c4 = CodeBlock(i=공통정보_입력_파싱)
# ---------- c1_c2_c3_c4.designscript (8 lines) ----------
[
i[0],
i[1],
i[2],
i[3],
i[4],
i[5]
];
# ----------------------------------------
code_block_28 = CodeBlock(c1_c4=c1_c2_c3_c4) { c1_c4; }
code_block_29 = CodeBlock(c1_c4=code_block_28) { c1_c4; }
makeExca = Python(IN[0]=code_block_18, IN[1]=group_closed_curves__function, IN[2]=getLocation, IN[3]=code_block_25, IN[4]=solidbyunion_예외처리, IN[5]=code_block_29)  # CPython3
# ---------- makeExca.python (238 lines) ----------
# Load the Python Standard and DesignScript Libraries
import sys
import clr
# Add Revit API references
clr.AddReference("RevitAPI")
clr.AddReference("RevitServices")
clr.AddReference('ProtoGeometry')
import Autodesk
from Autodesk.DesignScript.Geometry import *
from Autodesk.Revit.DB import *
from RevitServices.Persistence import DocumentManager
from RevitServices.Transactions import TransactionManager


import Revit
clr.ImportExtensions(Revit.Elements)
clr.ImportExtensions(Revit.GeometryConversion)
# Document and UI setup
doc = DocumentManager.Instance.CurrentDBDocument
################Module For Functional Programing#########################
from functools import reduce
from itertools import chain
from itertools import groupby
from copy import deepcopy

curry = lambda f: lambda a, *args: (
    f(a, *args) if (len(args)) else lambda *args: f(a, *args)
)

filter, map, reduce = curry(filter), curry(map), curry(reduce)

go = lambda *args: reduce(lambda a, f: f(a), args)  ## 함수도 축약 가능 ##


def dictUpdate(dic1, dic2):
    dic1.update(dic2)
    return dic1


def dictsMerge(dics):
    res = reduce(dictUpdate, dics)
    return res


def dictDeleteKeys(dic, keys):
    for k in keys:
        del dic[k]
    return dic


def update_nested_dict(dictionary, keys, value):
    current_dict = dictionary
    for key in keys[:-1]:
        current_dict = current_dict.setdefault(key, {})
    current_dict[keys[-1]] = value


def flat(a):
    if isinstance(a, list):
        for i in a:
            yield from flat(i)
    else:
        yield a


def grpBy(iter, key):
    f, grpKeys, grps = key, [], []
    sorted_ = sorted(iter, key=f)
    for key, grp_data in groupby(sorted_, key=f):
        grpKeys.append(key)
        grps.append(list(grp_data))
    return grps, grpKeys


#########################################################################

# The inputs to this node will be stored as a list in the IN variables.
dataEnteringNode = IN
exec_mode = IN[0]
group_closed_curves = IN[1]
below_refLines = IN[2]
VCF, GWL, G, GL = IN[3]
all_elem_solid = IN[4]
c1_d2 = IN[5]
# Place your code below this line


def make_excaSolid_perGrp(line_grp, VCF, GWL, G, GL, c1_d2):
    c1,c2,c3,c4,d1,d2 = c1_d2
    below_refPolyline = go(
        line_grp,
        PolyCurve.ByJoinedCurves,
        
    )
    
    btm_ref_Z = go(
        line_grp,
        map(lambda x: x.StartPoint.Z),
        min,
    )
    
    height_to_GL = GL - btm_ref_Z
    
    if height_to_GL > 0:
        upper_pre_refPolyline = go(
            below_refPolyline,
            lambda x: x.Translate(0,0,height_to_GL),
        )
        
        upper_offset_refPolyline = go(
            upper_pre_refPolyline,
            lambda x: x.OffsetMany(
                signedDistance=(height_to_GL * G),
                extendCircular=False,
                planeNormal=None
                ),
            lambda x: x[0],
        )
        
        if upper_pre_refPolyline.Length > upper_offset_refPolyline.Length:
            upper_offset_refPolyline = go(
                upper_pre_refPolyline,
                lambda x: x.OffsetMany(
                    signedDistance=-(height_to_GL * G),
                    extendCircular=False,
                    planeNormal=None
                    ),
                lambda x: x[0],
            )
        
        res = Autodesk.DesignScript.Geometry.Solid.ByLoft(
            [below_refPolyline, upper_offset_refPolyline]
        )
    else:
        res = None
    
    btmRefArea = below_refPolyline.Patch().Area / 10**6
    leanAndOthers_vol = btmRefArea * sum([c1,c2,c3,c4]) 
    
    return res, leanAndOthers_vol
    
def make_excaSolids(below_refLines, VCF, GWL, G, GL, c1_d2):
    below_refLine_grps = group_closed_curves(below_refLines)
    excaSolids = []
    leanAndOthers_vol = []
    for line_grp in below_refLine_grps:
        if make_excaSolid_perGrp(line_grp, VCF, GWL, G, GL, c1_d2)[0] != None:
            excaSolids.append(
                make_excaSolid_perGrp(line_grp, VCF, GWL, G, GL, c1_d2)[0]
            )
        leanAndOthers_vol.append(
            make_excaSolid_perGrp(line_grp, VCF, GWL, G, GL, c1_d2)[1]
        )
    res = Autodesk.DesignScript.Geometry.Solid.ByUnion(excaSolids)
    total_leanAndOthers = sum( leanAndOthers_vol )
    
    return res, total_leanAndOthers

def find_earthCalc_solids(below_refLines, VCF, GWL, G, GL, c1_d2):
    c1,c2,c3,c4,d1,d2 = c1_d2
    whole_exca_solid = make_excaSolids(below_refLines, VCF, GWL, G, GL, c1_d2)[0]
#    total_leanAndOthers = round( 
#        make_excaSolids(below_refLines, VCF, GWL, G, GL, c1_d2)[1], 3
#    )

    
    gwl_above_solid = go(
        whole_exca_solid,
        BoundingBox.ByGeometry,
        BoundingBox.ToCuboid,
        Geometry.Explode,
        filter( lambda x: x.NormalAtParameter(0.5,0.5).Z==1 ),
        next,
        lambda x: x.Thicken(GWL-GL, False),
        #lambda x: x.Thicken(5000),
    )
    split_for_gwl_solid = Geometry.Split( whole_exca_solid, gwl_above_solid )
    
    if len(split_for_gwl_solid)<2:
        above_exca_solid = split_for_gwl_solid[0]
        above_exca_solid_volume = round(above_exca_solid.Volume/10**9, 3)
        below_exca_solid_volume = 0.0
    else:
        above_exca_solid = split_for_gwl_solid[1]
        above_exca_solid_volume = round(above_exca_solid.Volume/10**9, 3)
        
        below_exca_solid = split_for_gwl_solid[0]
        below_exca_solid_volume = round(below_exca_solid.Volume/10**9, 3)
    
    split_for_disp_solid = Geometry.Split( whole_exca_solid, all_elem_solid )
    backfill_solid = split_for_disp_solid[0]
    backfill_solid_volume = round(backfill_solid.Volume/10**9, 3)
    
    disposal_solid = split_for_disp_solid[1]
    disposal_solid_volume = round(disposal_solid.Volume/10**9, 3)

    total_leanAndOthers = go(
        disposal_solid,
        Geometry.Explode,
        filter( lambda x: x.NormalAtParameter(0.5,0.5).Z==-1 ),
        map( lambda x: x.Thicken(sum([c1,c2,c3,c4])*1000, False) ),
        list,
        map(lambda x: x.Volume ),
        sum,
        lambda x: round(x / 10**9, 3),
    )

    res = [
        [
            backfill_solid,
            disposal_solid,
        ],
        [
            ["Above_GWL_Excavation Volume (m3)", round(above_exca_solid_volume, 3)],
            ["Below_GWL_Excavation Volume (m3)", round(below_exca_solid_volume, 3)],
            ["Total_Excavation Volume (m3)", round(whole_exca_solid.Volume/10**9, 3)],
            ["Backfill Volume (m3)", round((backfill_solid_volume - total_leanAndOthers), 3)],
            ["Disposal Volume (m3)", round((disposal_solid_volume + total_leanAndOthers), 3)],
            ["Disposal Volume_VCF (m3)", round((disposal_solid_volume + total_leanAndOthers) * VCF, 3)],
            #["Backfill Volume (m3)", backfill_solid_volume],
            #["Disposal Volume (m3)", disposal_solid_volume],
            #["Disposal Volume_VCF (m3)", disposal_solid_volume * VCF],
           
        ]
    ]

    
    return res


# Assign your output to the OUT variable.
if exec_mode == "물량산출모드":
    OUT = find_earthCalc_solids(below_refLines, VCF, GWL, G, GL, c1_d2)
    #OUT = make_excaSolids(below_refLines, VCF, GWL, G, GL, c1_d2)
    #OUT = group_closed_curves(below_refLines)
    #OUT = calc_allLeans_base_volume(c3c2_ratio)
else:
    OUT = [[[]]]
# ----------------------------------------
code_block_30 = CodeBlock(i=makeExca) { i[0][0]; }
if_2 = RefactoredIf(test=isEmpty, true=code_block_17, false=code_block_30)
categories_2 = Categories("OST_GenericModel")
time_stamp = Python()  # CPython3; unwired: IN[0]
# ---------- time_stamp.python (18 lines) ----------
# Load the Python Standard and DesignScript Libraries
import sys
import clr
clr.AddReference('ProtoGeometry')
from Autodesk.DesignScript.Geometry import *
from datetime import datetime
# The inputs to this node will be stored as a list in the IN variables.
dataEnteringNode = IN

# Place your code below this line


def log_with_timestamp():
    timestamp = datetime.now().strftime("%Y-%m-%d_%H%M%S")
    return f"Backfill shape_{timestamp}"
    #print(f"[{timestamp}] {message}")
# Assign your output to the OUT variable.
OUT = log_with_timestamp()
# ----------------------------------------
byGeometry = DirectShape.ByGeometry(geometry=if_2, category=categories_2, name=time_stamp)
토공_항목_별_산출_결과 = Watch(makeExca)  # graph output
code_block_31 = CodeBlock(i=if_) { i; }
c3_c2_ratio = CodeBlock(c2=code_block_3.out2, c1=code_block_3.out0, c3=code_block_3.out1)
# ---------- c3_c2_ratio.designscript (4 lines) ----------
[
c2/c1,
c3/c1
];
# ----------------------------------------
code_block_32 = CodeBlock(c3c2_ratio=c3_c2_ratio) { c3c2_ratio; }
code_block_33 = CodeBlock(c3c2_ratio=code_block_32) { c3c2_ratio; }
code_block_34 = CodeBlock(exec_mode=n0_1_실행모드_선택_확인_필수) { exec_mode; }

# group: 모델라인만 검출 - 삭제용
categories_3 = Categories("OST_Lines")
all_elements_of_category_2 = ElementsOfCategory(Category=categories_3)
code_block_35 = CodeBlock { "Detail Line"; }
getParameterValueByName_2 = Element.GetParameterValueByName(element=all_elements_of_category_2, parameterName=code_block_35)
detail_line_속성값은_1_아니면_0 = CodeBlock(i=getParameterValueByName_2) { i==0?true:false; }
filterByBoolMask_2 = List.FilterByBoolMask(list=all_elements_of_category_2, mask=detail_line_속성값은_1_아니면_0)

# group: 토공객체
토공객체_필터 = Python(IN[0]=code_block_34, IN[1]=filterByBoolMask_2.in)  # CPython3
# ---------- 토공객체_필터.python (205 lines) ----------
# Load the Python Standard and DesignScript Libraries
import sys
import clr
clr.AddReference('ProtoGeometry')
from Autodesk.DesignScript.Geometry import *

clr.AddReference("RevitNodes")
import Revit
clr.ImportExtensions(Revit.Elements)
#clr.AddReference("Revit.GeometryConversion")
clr.ImportExtensions(Revit.GeometryConversion)
#import Revit.GeometryConversion #import ProtoToRevit, RevitToProto
#from Revit import GeometryConversion

clr.AddReference('RevitAPI')
from Autodesk.Revit.DB import *
import Autodesk

clr.AddReference('RevitServices')
import RevitServices
from RevitServices.Persistence import DocumentManager
doc = DocumentManager.Instance.CurrentDBDocument


################Module For Functional Programing#########################
from functools import reduce
from itertools import chain
from itertools import groupby
from copy import deepcopy

curry = lambda f: lambda a, *args: (
    f(a, *args) if (len(args)) else lambda *args: f(a, *args)
)

filter, map, reduce = curry(filter), curry(map), curry(reduce)

go = lambda *args: reduce(lambda a, f: f(a), args)  ## 함수도 축약 가능 ##


def dictUpdate(dic1, dic2):
    dic1.update(dic2)
    return dic1


def dictsMerge(dics):
    res = reduce(dictUpdate, dics)
    return res


def dictDeleteKeys(dic, keys):
    for k in keys:
        del dic[k]
    return dic


def update_nested_dict(dictionary, keys, value):
    current_dict = dictionary
    for key in keys[:-1]:
        current_dict = current_dict.setdefault(key, {})
    current_dict[keys[-1]] = value


def flat(a):
    if isinstance(a, list):
        for i in a:
            yield from flat(i)
    else:
        yield a


def grpBy(iter, key):
    f, grpKeys, grps = key, [], []
    sorted_ = sorted(iter, key=f)
    for key, grp_data in groupby(sorted_, key=f):
        grpKeys.append(key)
        grps.append(list(grp_data))
    return grps, grpKeys


# The inputs to this node will be stored as a list in the IN variables.
dataEnteringNode = IN
exec_mode = IN[0]
model_lines = IN[1]

#########################################################################
def get_QGeometry(elem):
    # Revit Document 객체 가져오기
    doc = DocumentManager.Instance.CurrentDBDocument
    revitElement = UnwrapElement(elem)
    
    # Geometry 가져오기 옵션 설정
    geometryOptions = Options()
    geometryOptions.DetailLevel = ViewDetailLevel.Fine  # 세부 레벨 설정 (Fine, Medium, Coarse 등)
    geometryOptions.IncludeNonVisibleObjects = True    # 비가시 기하학 포함 여부
    
    # GeometryElement 가져오기
    #geometryElement = revitElement.get_Geometry(geometryOptions).ToProtoType()
    geometryElement = revitElement.get_Geometry(geometryOptions).ToProtoType()

    # Geometry 변환 리스트 초기화
    dynamoGeometries = []

    # GeometryElement 내의 GeometryObject 순회
    for geomObj in geometryElement:
        # Revit GeometryObject를 Dynamo Geometry로 변환
        dynGeom = geomObj#.ToProtoType()
        #dynGeom = Revit.GeometryConversion.RevitToProtoSolid.ToProtoType(geomObj)
        if dynGeom:
            dynamoGeometries.append(dynGeom)
    
    return dynamoGeometries

def get_all_BIC():

    db = [
    #Autodesk.Revit.DB.BuiltInCategory.OST_Rooms,
    Autodesk.Revit.DB.BuiltInCategory.OST_Floors,
    Autodesk.Revit.DB.BuiltInCategory.OST_EdgeSlab,
    #Autodesk.Revit.DB.BuiltInCategory.OST_Roofs,
    #Autodesk.Revit.DB.BuiltInCategory.OST_Walls,
    Autodesk.Revit.DB.BuiltInCategory.OST_StructuralFoundation,
    #Autodesk.Revit.DB.BuiltInCategory.OST_StructuralColumns,
    #Autodesk.Revit.DB.BuiltInCategory.OST_StructuralFraming,
    
    #Autodesk.Revit.DB.BuiltInCategory.OST_Ceilings,
    #Autodesk.Revit.DB.BuiltInCategory.OST_Doors,
    #Autodesk.Revit.DB.BuiltInCategory.OST_Windows,
    #Autodesk.Revit.DB.BuiltInCategory.OST_Stairs,
    #Autodesk.Revit.DB.BuiltInCategory.OST_GenericModel,
    ]
    return db
    
def get_allElems(doc):
    bics = get_all_BIC()
    
    def get_elems(x):
        collector = FilteredElementCollector(doc)
        res = collector.OfCategory(x).WhereElementIsNotElementType().ToElements()
        return res

    def get_ug_elems(x):
        collector = FilteredElementCollector(doc)
        allElems = collector.OfCategory(x).WhereElementIsNotElementType().ToElements()
        res = go(
            allElems,
            filter( lambda x: "UG" in x.LookupParameter("Family and Type").AsValueString() ),
            list,
        )
        return res

    def get_ug_cols():
        x = Autodesk.Revit.DB.BuiltInCategory.OST_StructuralColumns
        collector = FilteredElementCollector(doc)
        allElems = collector.OfCategory(x).WhereElementIsNotElementType().ToElements()
        res = go(
            allElems,
            filter( lambda x: "UG" in x.LookupParameter("Family and Type").AsValueString() ),
            list,
        )
        return res
        
    def get_ug_frames():
        x = Autodesk.Revit.DB.BuiltInCategory.OST_StructuralFraming
        collector = FilteredElementCollector(doc)
        allElems = collector.OfCategory(x).WhereElementIsNotElementType().ToElements()
        res = go(
            allElems,
            filter( lambda x: "UG" in x.LookupParameter("Family and Type").AsValueString() ),
            list,
        )
        return res

    def get_railElems(x):
        collector = FilteredElementCollector(doc)
        res = collector.OfCategory(x).WhereElementIsNotElementType().ToElements()
        return res
        
    def get_genericModels():
        x = Autodesk.Revit.DB.BuiltInCategory.OST_GenericModel
        collector = FilteredElementCollector(doc)
        allElems = collector.OfCategory(x).WhereElementIsNotElementType().ToElements()
        res = go(
            allElems,
            #filter( lambda x: DSCore.Object.Type(x)!="Revit.Elements.DirectShape" ),
            #filter( lambda x: type(x)!="Revit.Elements.DirectShape" ),
            filter( lambda x: "Backfil" in x.Name ),
            list,
        )
        return res

    res = get_genericModels()
    

    return res


# Place your code below this line



# Assign your output to the OUT variable.
if exec_mode == "토공객체삭제모드":
    OUT = get_allElems(doc) + model_lines
else:
    OUT = []
# ----------------------------------------

delete = Element.Delete(element=토공객체_필터)
parameters_3 = Element.Parameters(element=all_elementsexceptrails)
code_block_36 = CodeBlock(filtered_target=filter_line_etc) { filtered_target; }
total_leanAndOthers = Python(IN[0]=makeExca, IN[1]=code_block_29)  # CPython3; frozen
# ---------- total_leanAndOthers.python (92 lines) ----------
# Load the Python Standard and DesignScript Libraries
import sys
import clr
clr.AddReference('ProtoGeometry')
from Autodesk.DesignScript.Geometry import *
from Autodesk.Revit.DB import *
from RevitServices.Persistence import DocumentManager
from RevitServices.Transactions import TransactionManager

import Revit
clr.ImportExtensions(Revit.Elements)
clr.ImportExtensions(Revit.GeometryConversion)
# Document and UI setup
doc = DocumentManager.Instance.CurrentDBDocument
################Module For Functional Programing#########################
from functools import reduce
from itertools import chain
from itertools import groupby
from copy import deepcopy

curry = lambda f: lambda a, *args: (
    f(a, *args) if (len(args)) else lambda *args: f(a, *args)
)

filter, map, reduce = curry(filter), curry(map), curry(reduce)

go = lambda *args: reduce(lambda a, f: f(a), args)  ## 함수도 축약 가능 ##


def dictUpdate(dic1, dic2):
    dic1.update(dic2)
    return dic1


def dictsMerge(dics):
    res = reduce(dictUpdate, dics)
    return res


def dictDeleteKeys(dic, keys):
    for k in keys:
        del dic[k]
    return dic


def update_nested_dict(dictionary, keys, value):
    current_dict = dictionary
    for key in keys[:-1]:
        current_dict = current_dict.setdefault(key, {})
    current_dict[keys[-1]] = value


def flat(a):
    if isinstance(a, list):
        for i in a:
            yield from flat(i)
    else:
        yield a


def grpBy(iter, key):
    f, grpKeys, grps = key, [], []
    sorted_ = sorted(iter, key=f)
    for key, grp_data in groupby(sorted_, key=f):
        grpKeys.append(key)
        grps.append(list(grp_data))
    return grps, grpKeys


#########################################################################

# The inputs to this node will be stored as a list in the IN variables.
dataEnteringNode = IN
exca_res = IN[0]
c1_d2 = IN[1]
# Place your code below this line
if exca_res != [[[]]]:
    c1,c2,c3,c4,d1,d2 = c1_d2
    
    backfill_solid, disposal_solid = exca_res[0]
    members_btmThicken = go(
        disposal_solid,
        Geometry.Explode,
        filter( lambda x: x.NormalAtParameter(0.5,0.5).Z==-1 ),
        map( lambda x: x.Thicken(sum([c1,c2,c3,c4])*1000, False) ),
    )
    res = members_btmThicken
else:
    res = 0

# Assign your output to the OUT variable.
OUT = res
# ----------------------------------------
code_block_37 = CodeBlock(GL=elevation, BP=basePoint) { GL + BP.Z; }
code_block_38 = CodeBlock(pjtBP=basePoint, GL=elevation) { pjtBP.Z - GL; }
code_block_39 = CodeBlock(exec_mode=n0_1_실행모드_선택_확인_필수) { exec_mode; }
code_block_40 = CodeBlock(exec_mode=code_block_39) { exec_mode; }
output_출력 = Python(IN[0]=code_block_40, IN[1]=makeExca)  # CPython3
# ---------- output_출력.python (109 lines) ----------
# Load the Python Standard and DesignScript Libraries
import sys
import clr
import datetime  # For timestamp
clr.AddReference('ProtoGeometry')
from Autodesk.DesignScript.Geometry import *

# Revit Services와 DocumentManager 추가 (Revit API 접근)
clr.AddReference("RevitServices")
from RevitServices.Persistence import DocumentManager

################Module For Functional Programing#########################
from functools import reduce
from itertools import chain
from itertools import groupby
from copy import deepcopy

curry = lambda f: lambda a, *args: (
    f(a, *args) if (len(args)) else lambda *args: f(a, *args)
)

filter, map, reduce = curry(filter), curry(map), curry(reduce)

go = lambda *args: reduce(lambda a, f: f(a), args)  ## 함수도 축약 가능 ##


def dictUpdate(dic1, dic2):
    dic1.update(dic2)
    return dic1


def dictsMerge(dics):
    res = reduce(dictUpdate, dics)
    return res


def dictDeleteKeys(dic, keys):
    for k in keys:
        del dic[k]
    return dic


def update_nested_dict(dictionary, keys, value):
    current_dict = dictionary
    for key in keys[:-1]:
        current_dict = current_dict.setdefault(key, {})
    current_dict[keys[-1]] = value


def flat(a):
    if isinstance(a, list):
        for i in a:
            yield from flat(i)
    else:
        yield a


def grpBy(iter, key):
    f, grpKeys, grps = key, [], []
    sorted_ = sorted(iter, key=f)
    for key, grp_data in groupby(sorted_, key=f):
        grpKeys.append(key)
        grps.append(list(grp_data))
    return grps, grpKeys


#########################################################################


# The inputs to this node will be stored as a list in the IN variables.
dataEnteringNode = IN
exec_mode = IN[0]
data = IN[1]
# Place your code below this line

# 저장할 파일 경로 설정 (경로는 사용자에 맞게 수정)
# 현재 열려있는 Revit 문서 가져오기
doc = DocumentManager.Instance.CurrentDBDocument

# 파일 경로 가져오기
timestamp = datetime.datetime.now().strftime("%Y%m%d_%H%M%S")
# 리스트를 텍스트 파일로 저장
folder_path = "\\".join( doc.PathName.split("\\")[:-1] )
modeling_name = doc.PathName.split("\\")[-1].split(".rvt")[0]
file_path = folder_path + "\\" + modeling_name + f"_토공산출결과_{timestamp}.txt"

def save_txt(file_path, str):
    try:
        with open(file_path, "w", encoding="utf-8") as file:
#            for item in data:
#                # 리스트 항목을 문자열로 변환하고 줄바꿈 추가
#                file.write(str(item) + "\n")
            file.write(str + "\n")
        OUT = "파일 저장 성공: " + file_path
    except Exception as e:
        OUT = "파일 저장 실패: " + str(e)

# Assign your output to the OUT variable.
if exec_mode == "물량산출모드":
    str = go(
        data[1],
        map(lambda x: ": ".join( map(lambda y: str(y) , x) ) ),
        lambda x: "\n".join(x),
    )
    
    save_txt(file_path, str)
    OUT = "txt 파일 저장됨"
else:
    OUT = 0
# ----------------------------------------
python_script = Python()  # CPython3; frozen; unwired: IN[0]
# ---------- python_script.python (20 lines) ----------
# 필요한 모듈 불러오기
import clr
import datetime  # For timestamp
# Revit Services와 DocumentManager 추가 (Revit API 접근)
clr.AddReference("RevitServices")
from RevitServices.Persistence import DocumentManager

# 현재 열려있는 Revit 문서 가져오기
doc = DocumentManager.Instance.CurrentDBDocument


# Generate current timestamp (format: YYYYMMDD_HHMMSS)
timestamp = datetime.datetime.now().strftime("%Y%m%d_%H%M%S")
# 파일 경로 가져오기
folder_path = "\\".join( doc.PathName.split("\\")[:-1] )
modeling_name = doc.PathName.split("\\")[-1].split(".rvt")[0]
file_path = folder_path + "\\" + modeling_name + f"_토공산출결과_{timestamp}.txt"

# 경로 출력
OUT = file_path
# ----------------------------------------
code_block_41 = CodeBlock(socket=GL_elevation_decide) { socket+ sp_Z; }  # unwired: sp_Z
