# Dynamo graph [H_PAB.RT.Q2]_Revit 물량 산출_[3.1.5]_debug.dyn (Dynamo 2.16.1.2727)
# author: MK Jang
# Auto Calculating the Quantities of each Element As per the Family List

lang_mode_영_한_select = BoolSelector(true)

# group: All Data In Excel
n1_family_list_경로_입력 = Filename("..\etc\물량산출테스트용\debug\20241016_jyp\(H_PAB.OD.L2)_BIM 팀 표준 패밀리 리스트_r4_HGEN PCB 60.xlsx")  # "1. Family List 경로 입력"; graph input
file_from_path = FileObject(path=n1_family_list_경로_입력)
target_sheet_names = CodeBlock()
# ---------- target_sheet_names.designscript (19 lines) ----------
[
"WM-AR"
,"산출기준"
,"0.Room"
,"1.Floors"
,"2.Roofs"
,"3.Walls_Ext"
,"3.Walls_Int"
,"4.St_Fdn"
,"5.St_Col"
,"6.St_Framing"
,"7.Ceilings"
,"8.Doors"
,"9.Windows"
,"10.Stairs"
,"11.Railings"
,"12.Generic"
,"13.Manual_Input"
];
# ----------------------------------------
boolean = BoolSelector(true)
importExcel = Data.ImportExcel(file=file_from_path, sheetName=target_sheet_names, showExcel=boolean)

code_block = CodeBlock(i=importExcel) { i[0..15]; }

# group: All Elements in Revit
categories = Categories("OST_Rooms")
all_elements_of_category = ElementsOfCategory(Category=categories)
list_create = List.Create(item0=all_elements_of_category)
categories_2 = Categories("OST_Gutter")
all_elements_of_category_2 = ElementsOfCategory(Category=categories_2)
list_create_2 = List.Create(item0=all_elements_of_category_2)
all_elementsexceptrails = Python()  # CPython3; unwired: IN[0]
# ---------- all_elementsexceptrails.python (51 lines) ----------
# Load the Python Standard and DesignScript Libraries
import sys
import clr
clr.AddReference('ProtoGeometry')
from Autodesk.DesignScript.Geometry import *

clr.AddReference('RevitAPI')
from Autodesk.Revit.DB import *
import Autodesk

clr.AddReference('RevitServices')
import RevitServices
from RevitServices.Persistence import DocumentManager
doc = DocumentManager.Instance.CurrentDBDocument

def get_all_BIC():

    db = [
    Autodesk.Revit.DB.BuiltInCategory.OST_Floors,
    Autodesk.Revit.DB.BuiltInCategory.OST_Roofs,
    Autodesk.Revit.DB.BuiltInCategory.OST_Walls,
    Autodesk.Revit.DB.BuiltInCategory.OST_StructuralFoundation,
    Autodesk.Revit.DB.BuiltInCategory.OST_StructuralColumns,
    Autodesk.Revit.DB.BuiltInCategory.OST_StructuralFraming,
    Autodesk.Revit.DB.BuiltInCategory.OST_Ceilings,
    Autodesk.Revit.DB.BuiltInCategory.OST_Doors,
    Autodesk.Revit.DB.BuiltInCategory.OST_Windows,
    Autodesk.Revit.DB.BuiltInCategory.OST_Stairs,
    #Autodesk.Revit.DB.BuiltInCategory.OST_Railings,
    ]
    return db
    
def get_allElems(doc):
    bics = get_all_BIC()
    
    def getElems(x):
        collector = FilteredElementCollector(doc)
        res = collector.OfCategory(x).WhereElementIsNotElementType().ToElements()
        return res

    def getRailElems(x):
        collector = FilteredElementCollector(doc)
        res = collector.OfCategory(x).WhereElementIsNotElementType()
        return res

    res = map(getElems, bics)
#    res = getRailElems(Autodesk.Revit.DB.BuiltInCategory.OST_RailingSystemRail)
    return res


OUT = get_allElems(doc)
# ----------------------------------------
categories_3 = Categories("OST_EdgeSlab")
all_elements_of_category_3 = ElementsOfCategory(Category=categories_3)
list_create_3 = List.Create(item0=all_elements_of_category_3)
categories_4 = Categories("OST_StairsRailing")
all_elements_of_category_4 = ElementsOfCategory(Category=categories_4)
list_create_4 = List.Create(item0=all_elements_of_category_4)
categories_5 = Categories("OST_GenericModel")
all_elements_of_category_5 = ElementsOfCategory(Category=categories_5)
type = Object.Type(object=all_elements_of_category_5)
code_block_2 = CodeBlock(i=type) { i!="Revit.Elements.DirectShape"; }
filterByBoolMask = List.FilterByBoolMask(list=all_elements_of_category_5, mask=code_block_2)
list_create_5 = List.Create(item0=filterByBoolMask.in)
join = List.Join(list0=list_create, list1=list_create_2, list2=all_elementsexceptrails, list3=list_create_3, list4=list_create_4, list5=list_create_5)

# group: 모델링된 모든 객체의 패밀리 타입 명 추출 구간 (Room 객체의 경우 Number 속성값을 합쳐서 이름 추출)
code_block_3 = CodeBlock { "_"; }
flatten = List.Flatten(list=join)
type_2 = Object.Type(object=flatten)
code_block_4 = CodeBlock(i=type_2) { i=="Revit.Elements.Room"; }
filterByBoolMask_2 = List.FilterByBoolMask(list=flatten, mask=code_block_4)
code_block_5 = CodeBlock { "Number"; "Name"; }
getParameterValueByName = Element.GetParameterValueByName(element=filterByBoolMask_2.in, parameterName=code_block_5.out0)
getParameterValueByName_2 = Element.GetParameterValueByName(element=filterByBoolMask_2.in, parameterName=code_block_5.out1)
list_create_6 = List.Create(item0=getParameterValueByName, item1=getParameterValueByName_2)
transpose = List.Transpose(lists=list_create_6)
join_2 = String.Join(separator=code_block_3, string0=transpose)
code_block_6 = CodeBlock(i=join_2) { i[0]; }
code_block_7 = CodeBlock { "Type"; "Type Name"; }
getParameterValueByName_3 = Element.GetParameterValueByName(element=filterByBoolMask_2.out, parameterName=code_block_7.out0)
getParameterValueByName_4 = Element.GetParameterValueByName(element=getParameterValueByName_3, parameterName=code_block_7.out1)
join_3 = List.Join(list0=code_block_6, list1=getParameterValueByName_4)
list_create_7 = List.Create(item0=join_3, item1=flatten)

# group: Excel Dictionarize & 레빗 객체와 결합 딕셔너리 형성 및 심볼 / 값 추출
excel_data_dictionarization_3_0 = Python(IN[0]=lang_mode_영_한_select, IN[1]=code_block, IN[2]=target_sheet_names, IN[3]=list_create_7)  # "Excel data dictionarization_3.0.2_new"; CPython3
# ---------- excel_data_dictionarization_3_0.python (561 lines) ----------
# Load the Python Standard and DesignScript Libraries"
import sys
import clr
clr.AddReference('ProtoGeometry')
from Autodesk.DesignScript.Geometry import *

################Module For Functional Programing#########################
from functools import reduce
from itertools import chain
from itertools import groupby
from copy import deepcopy
curry = lambda f: lambda a,*args: f(a, *args) if (len(args)) else lambda *args: f(a, *args)

filter = curry(filter)
map = curry(map)
reduce = curry(reduce)

go = lambda *args: reduce(lambda a,f: f(a), args) ## 함수도 축약 가능 ##

def dictUpdate(dic1,dic2):
    res = dic1.update(dic2)
    return dic1
    
def dictsMerge(dics):
    res = reduce(dictUpdate, dics)
    return res
    
def dictDeleteKeys(dic, keys):
    for k in keys:
        del dic[k]
    return dic

def flat(a):
    if isinstance(a, list):
        for i in a: 
            yield from flat(i)
    else: yield a
#########################################################################

import re
from functools import partial

# The inputs to this node will be stored as a list in the IN variables.
dataEnteringNode = IN
lang_mode = IN[0]
wholeDatas = IN[1]
db = wholeDatas[1:]
allCatSheetsNames = IN[2][2:]
allCatSheetsNames_noRoom = allCatSheetsNames[1:]

calcStdSheet = db[0] ##산출기준 시트
allCatSheets = db[1:]

allElemsNames = IN[3][0]
allElems = IN[3][1]
allElemsSet = list(zip(allElemsNames, allElems))


#wmspec_headers = [
#    "Work Master Code" ,"GaugeCode" ,"Unit" ,"Work Category-L1"
#    ,"Work Category-L2" ,"Work Category-L3" ,"Spec. 1- L4" ,"Spec. 2- L5"
#    ,"Spec. 3- L6" ,"Spec. 4- L7" ,"Spec. 5- L8" ,"Spec. 6- L9"
#    ,"Spec. 7- L10" ,"Spec. 8- L11" ,"BOQ Spec1" ,"BOQ Spec2" ,"BOQ Spec3"
#    ,"BOQ Spec4" ,"BOQ Spec5" ,"BOQ Spec6" ,"BOQ Spec7" ,"BOQ Spec8" ,"BOQ Spec9"
#    ,"Work Master Code /w Description", "Description" ,"입찰_물량산출식" ,"실행_물량산출식" ,"rIDX"
#]
# Place your code below this line

def find_IsInStr(target, string):
    if target == None or string == None:
        pass
    else:
        res = str(target) in str(string)
        return res

def find_range_by_columnItem(db, col_idx, sep_rule):
    tdb = list(map(lambda x: x[col_idx], db)) ##targetTransposedDB (col_idx에 해당하는 데이터만 추출)
    last_idx_tdb = len(tdb)-1
    tdb_enum = enumerate(tdb)
    target_RowNumber = list(filter(lambda x: find_IsInStr(sep_rule, x[1]), tdb_enum))
    endidxs_tmp= list(map(lambda x: x[0]-1,target_RowNumber))
    endidxs_tmp.pop(0)
    endidxs = endidxs_tmp + [last_idx_tdb] ## 각 구간별 마지막 행 번호
    rangeSttIdxs = list(map(lambda x: x[0]+1,target_RowNumber))
    rangeEndIdxs = endidxs
    result = list(zip(rangeSttIdxs, rangeEndIdxs))
    return result

    
def find_headersAtSheet(sheet):
    headers_sheet = list(map(lambda x: [x[1].replace("\n",""),x[0]], filter(lambda x: x[1] != None, enumerate(sheet[1]))))
    
    return dict(headers_sheet)
    #return list(headers_sheet)

def find_rangesAtSheet(sheet, hdrs_withIdxDict, trgt_hdr, trgt_str):
    #hdrs_withIdxDict = dict(hdrs_withIdx)
    return find_range_by_columnItem(sheet, hdrs_withIdxDict[trgt_hdr], trgt_str)


def get_DataOnGrpsAtSheet(sheet:list, discrHDRStr, discrRowStr):
    """
    판별기준 Header문자열(discrHDRStr)이 들어있는 열에서,
    판별기준 행 문자열(discrRowStr)이 들어있는 행번호 기준으로 구역을 나누어 데이터 리스트 반환
    """
    hdrs_withIdxDict = find_headersAtSheet(sheet)

    # 시트별 그룹 구분 (시작 행번호, 끝 행 번호 추출)
    rowAreasAtSheet = find_rangesAtSheet(sheet, hdrs_withIdxDict, discrHDRStr, discrRowStr)
    
    # 시트 각행에 rIDX 데이터 주입하는 구간 - (시작) >>>>>>>
    ## 헤더의 칼럼 인덱스 중 가장 큰 것 추출
    hdrs_maxCol_idx = max(list(hdrs_withIdxDict.values()))
    ## 마지막 헤더위치보다 한칸 옆을 행인덱스번호("rIDX") 정보 보관 위치로 설정
    hdrs_withIdxDict["rIDX"] = hdrs_maxCol_idx+1
    ## 시트의 각 행을 번호와 함께 pair 형태로 추출
    sheetWith_rIDX = list(enumerate(sheet))
    ## rIDX 보관된 시트 데이터 저장을 위한 빈 리스트 선언
    sheet_rIDX = []
    ## pair 형태의 각 행에서, 마지막 헤더의 한칸 우측위치에 rIDX 데이터 주입
    ## 시트의 각 행마다 x 라는 이름으로 순회하며,
    for x in sheetWith_rIDX:
        ### 행의 전체 데이터 길이가 마지막 헤더 위치보다 클때,
        if len(x[1])-1>hdrs_maxCol_idx:
        #if len(x)>hdrs_maxCol_idx:
            #### 마지막 헤더의 우측 칸 위치를 rIDX 데이터로 치환
            x[1][hdrs_maxCol_idx+1] = x[0]
            sheet_rIDX.append(x[1])
            
        ### 행의 전체 데이터 길이가 마지막 헤더 위치와 같을때,
        else:
            #### 마지막 헤더의 우측칸이 없으므로 append로 rIDX 데이터 추가
            x[1].append(x[0])
            sheet_rIDX.append(x[1])
    # <<<<< 시트 각행에 rIDX 데이터 주입하는 구간 - (끝)
    
    rowsGrps_perType_withNone = list(map(lambda x: sheet_rIDX[x[0]-1:x[1]], rowAreasAtSheet))
    # None 데이터 치환 구간
    rowsListGrps_perType = go(#>
        rowsGrps_perType_withNone, list,
        ## 하나의 타입을 규정하는 행들의 모임에서
        map(lambda rowGrp: \
        ## 한 행씩 골라서
        list(map(lambda row: \
        ## 행을 구성하는 셀 값 중 None이 있으면 빈문자열로 치환
        list(map(lambda cell: "" if cell==None else cell, row)), rowGrp)) ),
        ## 맵 객체가 반환되므로 리스트 변환
        list,
    )#<
    
    return (rowsListGrps_perType, hdrs_withIdxDict)

def cvt_rowsListGrps_toDictGrps(rowsListGrps_perType, hdrs_withIdxDict, sheetName):
    """
    헤더 행과 다수의 컨텐츠 행으로 이루어진 rowListGrps를,
    모든 행을 헤더와 결합된 딕셔너리화 해서 rowDictGrps를 만드는 함수
    """
    eff_hdrs_idx = hdrs_withIdxDict.values()
    eff_hdrs_name = hdrs_withIdxDict.keys()
    
    rowsDictGrps_perType = go(#>
        rowsListGrps_perType,
        ## 하나의 타입을 규정하는 행들의 모임에서 한 행 씩 조작하는 함수들을 구상 후
        ## 맵 함수 내에서 go로 합성하여 반복시켜 사용
        map(lambda rowGrp: go(#>>
            ### 그룹 전체 가져와서
            rowGrp,
            ### 각 행을 리스트 타입으로 변환
            map(list), list,
            ### 헤더에 해당하는 행 값을 추출--
            map(lambda row: list(map(lambda idx: row[idx], eff_hdrs_idx))), list,
            ### 헤더이름과 행 내부의 값을 2개씩 짝지어 줌
            map(lambda row: list(zip(eff_hdrs_name, row))), list,
            ### 헤더이름 : 값의 형태로 각 행 데이터를 딕셔너리로 만듬
            map(lambda x: dict(x)),
            ### 딕셔너리 마다 카테고리 정보 추가
            map(lambda x: dictUpdate(x,{"Family Category":sheetName})),
            list,
            )#<<
        ), list,
    )#<
    return rowsDictGrps_perType

# 행딕셔너리 별 입력한 규칙에 따라 참거짓 여부를 반환하는 함수
def findRow_AppliedType(rowDict, tgtHDRname, rule=None):
    p = re.compile('[0-9]{3,5}')
    target = str(rowDict[tgtHDRname])
    ## 함수 호출시 구분자(rule) 없이 호출한 경우
    ## -Room Category 시트 용 이며 "Standard Type" 항목의 값이 000형태의 숫자인지를 판별
    ## -Room Category 중 "Standard Type" 칼럼에 룸 넘버, "Family Type Name" 칼럼에 룸 이름 입력하게 되어있음
    if rule==None:
        p = re.compile('[0-9]{3,5}')
        m = p.match(target)
        stdCase = target =="Room No"
        res = all([m or stdCase])
    ## 구분자(rule)가 정규표현식 객체로 들어온 경우
    elif isinstance(rule, re.Pattern):
        m = p.match(target)
        res = all([m])
    ## 구분자(rule)가 문자열로 들어온 경우
    else:
        res = rule in target
    return res



def form_TypeDict(rowsDictGrps,titleKeyName,sttIdx):
    """
    rowsDictGrps_perType을 받아서 각 그룹의 이름을 키로 하는
    새로운 중첩구조의 Dictionary를 만들어서,
    바깥에서 타입이름으로 딕셔너리에 접근하면 
    바로 해당 구성내용을 반환해주는 데이터 구조를 만드는 함수
    """
    typeDict = go(#>
        rowsDictGrps, list,
        filter(lambda x: x!=[]),
        map(lambda rowsDictGrp: \
            ### 그룹 전체 첫행 중 타이틀키값과 나머지 row 들 dict를 짝지어 새로운 딕셔너리로 형성
            [list(rowsDictGrp)[0][titleKeyName],go(#>>
                list(rowsDictGrp)[sttIdx:],
                #### 모두 빈칸인 값일때 제외 필터링
                filter(lambda row: any(list(map(lambda cell: cell!="", list(row.values()))))),
                list,
            )]#<<
        ),list,
        dict,
    )#<
    
    return typeDict

def updateDict_symValPair(calcTypeDict):
    """
    calcTypeDict를 입력으로 받아서
    필요한 "약자-대응 항목" 의 구조를 갖는 딕셔너리 형태로
    구성된 새로운 Dictionary를 반환하는 함수
    """
    # 모든 산출타입 이름 추출
    allCalcTypeNames = list(calcTypeDict.keys())
    # 전체 결과물 담을 빈 딕셔너리 선언
    res = {}
    # 산출타입태그 이름 각각에 대해,
    for x in allCalcTypeNames:
        ## 타입별 약자 - 산출 대상 값 을 매칭하기위한 빈 딕셔너리 선언
        type = {}
        ## 산출기준 시트의 각 행을 딕셔너리화 한 rD마다 값을 들여다보며
        for rD in calcTypeDict[x]:
            ### 행 딕셔너리의 "수동 입력값" 항목의 값이 유효한 값이고,
            ###"산출수식 약자" 항목에도 유효한 값이 있다면
            if rD["수동 입력값"]!="" and rD["산출수식 약자"]!="":
                #### 신규 딕셔너리인 type에 키를 산축수식 약자로 하고,
                #### 값을 수동입력값이나 Parameter 항목 값으로 하는 딕셔너리 형성
                type[rD["산출수식 약자"]] = rD["수동 입력값"]
            elif rD["Parameter"]!="" and rD["산출수식 약자"]!="":
                type[rD["산출수식 약자"]] = rD["Parameter"]
        ## 전체를 담을 빈딕셔너리인 res에 
        ## 키를 산축수식 약자로 하고, 값을 아까 마련한 type 딕셔너리로 하는 딕셔너리로 만듬
        res[x] = type
    # 최종결과 반환
    return res
   

def find_stdWMdicts_inGrp(rowsDictGrp):
    res = go(
        rowsDictGrp, list,
        ## 엑셀 "물량산출식", "Work Master Code" 열에 값이 없는 행 제외
        filter(lambda rD: rD["입찰_물량산출식"] != "" and rD["실행_물량산출식"] != ""),
        filter(lambda rD: rD["Work Master Code"] != ""),
        filter(lambda rD: isinstance(rD["Work Master Code"], str)), ### 7/18 오류제보 반영
        ## Family Type Name에 "H_" 문자열 포함된 경우 제외
        filter(lambda rD: not findRow_AppliedType(rD, "Family Type Name", rule="H_")),
        ## 행 딕셔너리의 NO, Standard Type 업데이트
        map(lambda rD: dictUpdate(rD,{"NO":rowsDictGrp[0]["NO"], "Standard Type":rowsDictGrp[0]["Standard Type"]})),
        ## Q'ty Cal Type Tag 업데이트
        map(lambda rD: dictUpdate(rD,{"Q'ty Cal Type Tag":rowsDictGrp[0]["Q'ty Cal Type Tag"]})),
        list,
    )
    return res


def find_stdWMdicts_forCat(rowsDictsGrps):
    res = go(#>
        rowsDictsGrps, list,
        map(find_stdWMdicts_inGrp),
        #filter(lambda x: x!=[]),
        list,
    )#<
    return res

def find_appliedTypeDicts_forCat(rowsDictsGrps):
    catName = rowsDictsGrps[0][0]["Family Category"]
    eff_hdrs_name = list(rowsDictsGrps[0][0].keys())
    wmspec_headers = ["Family Category", "Work Master Code", "GaugeCode", "Unit"]\
        + list(filter(lambda x: "Work Cat" in x or "Spec" in x, eff_hdrs_name))\
        + ["Work Master Code /w Description", "Description","입찰_물량산출식", "실행_물량산출식", "rIDX"]
    #stdWMsDicts = find_stdWMdicts_forCat(rowsDictGrps)
    
    appliedTypeDicts = go(#>
        rowsDictsGrps,
        map(lambda rowsDictsGrp: go(#>>
            rowsDictsGrp, list,
            ## Family Type Name에 "H_" 문자열 포함된 경우만 필터링
            filter(lambda rD: findRow_AppliedType(rD, "Family Type Name", rule="H_")),
            ## 행 딕셔너리의 NO, Standard Type 업데이트 - 추후 함수 분리 염두
            map(lambda rD: dictUpdate(rD,{"NO":rowsDictsGrp[0]["NO"], "Standard Type":rowsDictsGrp[0]["Standard Type"]})),
            ## 그룹 첫행을 기준으로 Q'ty Cal Type Tag 업데이트 - 추후 함수 분리 염두
            map(lambda rD: dictUpdate(rD,{"Q'ty Cal Type Tag":rowsDictsGrp[0]["Q'ty Cal Type Tag"]})),
            
            # wmSpecs 속성들을 헤더로 하는 새로운 딕셔너리 형성 및 값 추가(값은 list형태)
            map(lambda rD: dictUpdate(rD, {"wmSpecs": go(
                ### wmspec관련 항목들 값을 리스트로 모음
                map(lambda x: rD[x], wmspec_headers), list,
                ### 항목명과 항목값을 모아서 딕셔너리 형태로 변환
                lambda x: zip(wmspec_headers,x), dict,
                ### wmSpecs 항목을 리스트 구조로 수정해 두기
                lambda x: [x] if x["Work Master Code"]!="" else [],
                
            )}) ),
            ## 밖으로 꺼내진 WorkMaster 관련 속성 삭제
            map(lambda rD: dictDeleteKeys(rD, wmspec_headers)), list,
            ## 각 딕셔너리마다 카테고리 명 입력
            #map(lambda rD: dictUpdate(rD, {"Family Category":catName})),
            list,
            )#<<
        ),
        # 실적용 패밀리타입이 없는 그룹은 제외하는 구간
        filter(lambda x: list(x)!=[]),
        list,
    )#<
    
    return appliedTypeDicts

def find_appliedTypeDicts_forRoom(rowsDictsGrps):
    eff_hdrs_name = list(rowsDictsGrps[0][0].keys())
    wmspec_headers = ["Family Category", "Work Master Code", "GaugeCode", "Unit"]\
        + list(filter(lambda x: "Work Cat" in x or "Spec" in x, eff_hdrs_name))\
        + ["Work Master Code /w Description", "Description","입찰_물량산출식", "실행_물량산출식", "rIDX"]
    
    appliedTypeDicts = go(#>
        rowsDictsGrps,
        map(lambda rowsDictsGrp: go(#>>
            rowsDictsGrp, list,
            ## Standard Type 에 "H_" 문자열 포함된 경우만 필터링(only for room)
            filter(lambda rD: findRow_AppliedType(rD, "Standard Type")),
            ## 행 딕셔너리의 NO, Standard Type 업데이트 - 추후 함수 분리 염두
            map(lambda rD: dictUpdate(rD,{"NO":rD["Standard Type"], "Standard Type":rowsDictsGrp[0]["Standard Type"]})),
            ## 그룹 첫행을 기준으로 Q'ty Cal Type Tag 업데이트 - 추후 함수 분리 염두
            map(lambda rD: dictUpdate(rD,{"Q'ty Cal Type Tag":rowsDictsGrp[0]["Q'ty Cal Type Tag"]})),
            
            # wmSpecs 속성들을 헤더로 하는 새로운 딕셔너리 형성 및 값 추가(값은 list형태)
            map(lambda rD: dictUpdate(rD, {"wmSpecs": go(
                ### wmspec관련 항목들 값을 리스트로 모음
                map(lambda x: rD[x], wmspec_headers), list,
                ### 항목명과 항목값을 모아서 딕셔너리 형태로 변환
                lambda x: zip(wmspec_headers,x), dict,
                ### wmSpecs 항목을 리스트 구조로 수정해 두기
                lambda x: [x] if x["Work Master Code"]!="" else [],
                
            )}) ),
            ## 밖으로 꺼내진 WorkMaster 관련 속성 삭제
            map(lambda rD: dictDeleteKeys(rD, wmspec_headers)), list,
            
            ## Room 의 경우는 "No"와 "Family Type Name"을 합쳐서 "Family Type Name"에 입력
            map(lambda rD: dictUpdate(rD,{"Family Type Name":str(rD["NO"]).split('.')[0]+"_"+rD["Family Type Name"]})),
            
            list,
            )#<<
        ),
        # 실적용 패밀리타입이 없는 그룹은 제외하는 구간
        filter(lambda x: list(x)!=[]),
        list,
    )#<
    
    return appliedTypeDicts

def merge_sameFamType_wmSpecs(appliedTypeDicts):
    def merge_inGrp(appliedTypeDicts_perGrp):
        """
        엑셀 타입별 행그룹 내에서 실 적용 패일리명이 들어있는
        행들만 추출하고, 그 중 이름이 같은 것들의 wm 정보는 합쳐서
        하나의 이름에 하나의 딕셔너리 객체만 존재하도록 수정
        """
        ## 그룹 내 실 적용 패밀리 타입 명 추출(중복 불허)
        keysPerGrp = go(#>
            appliedTypeDicts_perGrp,
            ## 개별 행딕셔너리의 패밀리 타입 항목 값 추출
            map(lambda rD: rD["Family Type Name"]),
            ## 문자열 내 "H_"가 포함되어있는 지 검사
            filter(lambda x: "H_" in x),
            ## 중복 Family Type Name 단일화
            set, list,
        )#<
        ## 패밀리 타입 명을 k라는 변수명으로 하나씩 순회
        for k in keysPerGrp:
            ### k라는 패밀리 타입 명에 해당하는 딕셔너리 모두 검색
            sameNameDicts = list(filter(lambda x: x["Family Type Name"] == k, appliedTypeDicts_perGrp))
            ### 하나의 타입명에 복수 객체인지를 검사하여
            ### 2개 이상인 경우
            if len(sameNameDicts)>=2:
                ### 동일 이름의 딕셔너리들 중 첫번째 항목의 "wmSpecs"에
                ### 나머지 항목의 wmSpecs 항목을 몰아준다
                for i,rD in enumerate(sameNameDicts[1:]):
                    if rD["wmSpecs"]:
                        sameNameDicts[0]["wmSpecs"].append(*rD["wmSpecs"])
                    else: pass
                ### 몰아주기가 끝나면, 첫번째를 제외한 나머지 딕셔너리는
                ### 불필요해지므로 삭제
                appliedTypeDicts_perGrp.remove(sameNameDicts[i+1])
            else:                
                pass
        ## 수정된 딕셔너리들 리스트를 반환
        return appliedTypeDicts_perGrp
    # 단위 그룹에 대한 함수를 복수 그룹들 전체에 시행
    return map(merge_inGrp, appliedTypeDicts)



def inject_stdWMtoAppliedTypeDicts(appliedTypeDicts, allCat_stdWMdicts_stdTypeName):
    def inject_inGrp(appliedTypeDict_perGrp):
        """
        타입 그룹 별 공통 WM 딕셔너리 항목들을
        실적용패밀리 딕셔너리에 주입하는 함수
        """
        ## 실적용패밀리 딕셔너리 리스트의 구성 원소 각각을
        ## rD(rowDictionary) 라는 이름으로 순회
        for rD in appliedTypeDict_perGrp:
            ### rD의 "Standard Type" 항목 값이
            ### 입력받은 타입별 공통 WM항목 딕셔너리의 키값중에
            ### 포함되었는지 검사후 있으면,
            if rD["Standard Type"] in list(allCat_stdWMdicts_stdTypeName.keys()):
                #### rD의 "wmSpecs" 항목에 공통 WM항목을 추가하여 재할당
                rD["wmSpecs"] = rD["wmSpecs"] + allCat_stdWMdicts_stdTypeName[rD["Standard Type"]]
            else:
                pass
        ## 수정된 딕셔너리들 리스트를 반환
        return appliedTypeDict_perGrp
    # 단위 그룹에 대한 함수를 복수 그룹들 전체에 시행
    return list(map(inject_inGrp, appliedTypeDicts))
    
def updateFamTypeDicts_symValPair(total_appliedTypeDicts, calcTypeDict_symValPair):
    """
    실적용패밀리타입명 별 딕셔너리에
    "Q'ty Cal Type Tag" 항목 값 이름과 일치하는
    물량산출 매개변수 꾸러미 추가하는 함수
    """
    # 전체 결과물 담을 빈 딕셔너리 선언
    res = {}
    # 전체 실적용 패밀리 딕셔너리들 중 구성원소 각각을 d라는 이름으로 순회
    for d in total_appliedTypeDicts:
        ## 딕셔너리의 "Q'ty Cal Type Tag"항목의 값이 빈문자열이 아니라면,
        if d["Q'ty Cal Type Tag"]!="":
            ### 딕셔너리에 "Sym_Val Dict"라는 키를 추가하고
            ### calcTypeDict 중 일치하는 값을 골라 키의 값으로 할당
            symValPair = calcTypeDict_symValPair[d["Q'ty Cal Type Tag"]]
            d["Sym_Val Dict"] = symValPair
        ## 전체용 빈 딕셔너리에 패밀리 타입명을 키로 추가하고
        ## 방금 수정한 단위 딕셔너리를 키의 값으로 할당
        res[d["Family Type Name"]] = d    
    return res
    
def matchWith_Elem_Dict(famlist_dic,revitElems):
    """
    레빗객체와 패밀리리스트 딕셔너리의 정보를 하나로 결합해주는 용도의 함수
    패밀리리스트 데이터는 패밀리 타입명을 키값으로 하는 하나의 딕셔너리로 정리되어있어야 한다
    revit객체는 패밀리리스트 상 존재하는 타입만 필터링해서 입력해야 함
    """
    # 수행결과를 모을 빈 리스트 선언
    res = []
    # 모든 레빗 객체들을 하나씩 순회 
    for i in revitElems:
        ## revit 객체들과 revit 타입별 Family List 딕셔너리를 결합하기 위한 빈 딕셔너리 선언
        combD = {}
        ## 패밀리 타입명 추출 - Room 객체인 경우와 아닌 경우 분기
        if "Room" in str(type(i)):
            famTypeName = i.GetParameterValueByName("Number") + "_" + i.GetParameterValueByName("Name")
        else:
            famTypeName = i.GetParameterValueByName("Type").GetParameterValueByName("Type Name")
        ## 결합용 딕셔너리의 "Elem" 이라는 키에 순회 중인 i (revit객체)를 할당
        combD["Elem"] = i
        combD["GUID"] = i.GetParameterValueByName("IfcGUID")
        ## 결합용 딕셔너리의 "wms" 이라는 키에 
        ## 순회 중인 i (revit객체) 패밀리 타입 명과 일치하는 famlist_dictionary의 값을 할당
        try:
            combD["wms"] = deepcopy(famlist_dic[famTypeName])
            ##결합된 딕셔너리를 res에 저장
            res.append(combD)
        except:
            pass
    # 전체 수행 결과 반환
    return res

def update_sym_valDict(matched_elemDicts):
    def update_sym_valDict_single(d):
        """
        딕셔너리별로 포함된 ["wms"]["Sym_Val Dict"]항목 내에
        아직 계산되지 않은 매개변수 값들을 계산하여
        "Post_Sym_Val Dict"라는 새로운 키의 값으로 할당하는 함수
        """
        e = d["Elem"]
        newSymValDict = {}
        keys = d["wms"]["Sym_Val Dict"].keys()
        vals = d["wms"]["Sym_Val Dict"].values()
        for s,v in zip(keys, vals):
            ## Vals 항목이 사용자 입력값이 아닌 revit 매개변수인 경우
            if isinstance(v,str):
                if v not in list(map(lambda x: x.Name, e.Parameters)):
                    calc_v = e.ElementType.GetParameterValueByName(v)
                else:
                    calc_v = e.GetParameterValueByName(v)
                calc_vv= calc_v if isinstance(calc_v, str) else round(calc_v, 3)
                newSymValDict[s] = calc_vv
            ## Vals 항목이 사용자 입력값인 경우는 그대로 입력된 숫자 사용
            else:
                newSymValDict[s] = v
        d["wms"]["Post_Sym_Val Dict"] = newSymValDict
        
        return d
    return list(map(update_sym_valDict_single, matched_elemDicts))



    
calcSheet_rowsListGrps_perType = get_DataOnGrpsAtSheet(calcStdSheet, "구간판별", "#")
calcSheet_rowsDictGrps_perType = cvt_rowsListGrps_toDictGrps(*calcSheet_rowsListGrps_perType,"")
calcTypeDict = form_TypeDict(calcSheet_rowsDictGrps_perType,"Q'ty Cal Type Tag",sttIdx=1)
calcTypeDict_symValPair = updateDict_symValPair(calcTypeDict)

roomSheet_rowsListGrps_perType = get_DataOnGrpsAtSheet(allCatSheets[0], "Standard Type", "H_")
roomSheet_rowsDictGrps_perType = cvt_rowsListGrps_toDictGrps(*roomSheet_rowsListGrps_perType,"0.Room")
room_stdWMdicts = find_stdWMdicts_forCat(deepcopy(roomSheet_rowsDictGrps_perType))
room_stdWMdicts_stdTypeName = form_TypeDict(room_stdWMdicts, "Standard Type",sttIdx=0)

room_appliedTypeDicts = find_appliedTypeDicts_forRoom(roomSheet_rowsDictGrps_perType)
room_appliedTypeDicts_noDupl = merge_sameFamType_wmSpecs(room_appliedTypeDicts)

room_appliedTypeDicts_withStdWm = list(chain(*inject_stdWMtoAppliedTypeDicts(room_appliedTypeDicts_noDupl, room_stdWMdicts_stdTypeName)))

# 룸 제외 모든 카테고리 시트 처리
allCatSheet_rowsListGrps = map( lambda x: get_DataOnGrpsAtSheet(x, "Standard Type", "H_"), allCatSheets[1:] )
allCatSheet_rowsListGrps_namesPair = list(zip(allCatSheet_rowsListGrps, allCatSheetsNames_noRoom))
allCatSheet_rowsDictGrps = map( lambda x: cvt_rowsListGrps_toDictGrps(*x[0],x[1]), allCatSheet_rowsListGrps_namesPair )

# "Standard Type" 별 wm 공통항목 찾기
allCat_stdWMdicts = list(map( lambda x: find_stdWMdicts_forCat(x), deepcopy(allCatSheet_rowsDictGrps) ))
# "Standard Type" 명으로 검색할 수 있는, 전 카테고리 "Standard Type" 별 공통 WM항목 사전 만들기
allCat_stdWMdicts_stdTypeName = dictsMerge(list(map(lambda x: form_TypeDict(x, "Standard Type",sttIdx=0), allCat_stdWMdicts)))

allCat_appliedTypeDicts = map( lambda x: find_appliedTypeDicts_forCat(x), allCatSheet_rowsDictGrps )
allCat_appliedTypeDicts_noDupl = map( lambda x: merge_sameFamType_wmSpecs(x), allCat_appliedTypeDicts )

allCat_appliedTypeDicts_withStdWm = list(chain(*chain(*map( lambda x: inject_stdWMtoAppliedTypeDicts(x,allCat_stdWMdicts_stdTypeName), allCat_appliedTypeDicts_noDupl ))))

total_appliedTypeDicts = room_appliedTypeDicts_withStdWm + allCat_appliedTypeDicts_withStdWm
FamTypeDicts_symValPair = updateFamTypeDicts_symValPair(total_appliedTypeDicts,calcTypeDict_symValPair)

allUsedFamTypeNames_Excel = FamTypeDicts_symValPair.keys()
allElemsFiltered_byExcel = list(map(lambda y: y[1], list(filter(lambda x: x[0] in allUsedFamTypeNames_Excel , allElemsSet))))

allElemsDict = update_sym_valDict(matchWith_Elem_Dict(FamTypeDicts_symValPair, allElemsFiltered_byExcel))
# Assign your output to the OUT variable.

OUT = allElemsDict, FamTypeDicts_symValPair, calcTypeDict_symValPair
# ----------------------------------------
code_block_8 = CodeBlock(i=excel_data_dictionarization_3_0) { i; }
allTypes = CodeBlock(i=code_block_8) { i[1]; }
allElemsDict = CodeBlock(i=code_block_8) { i[0]; }
allElemsDict_2 = CodeBlock(dictionarizedTypes=allElemsDict) { dictionarizedTypes; }

# group: 필터링 구간 (패밀리 리스트에 없는 이름 제외)
keys = DesignScript.Builtin.Dictionary.Keys(dictionary=allTypes)
contains = List.Contains(list=keys, item=getParameterValueByName_4@L1)
filterByBoolMask_3 = List.FilterByBoolMask(list=getParameterValueByName_4, mask=contains)

uniqueItems = List.UniqueItems(list=filterByBoolMask_3.in)
n2_물량산출모드_입찰_실행 = CustomSelection("실행", items={입찰: "입찰", 실행: "실행"})  # "2. 물량산출모드(입찰 / 실행)"; graph input
code_block_9 = CodeBlock(calcMode=n2_물량산출모드_입찰_실행) { calcMode; }
code_block_10 = CodeBlock(calcMode=code_block_9) { calcMode; }
code_block_11 = CodeBlock()
# ---------- code_block_11.designscript (9 lines) ----------
wmspec_headers = [
    "Work Master Code" ,"GaugeCode" ,"Unit" ,
    "Work Category-L1"
    ,"Work Category-L2" ,"Work Category-L3" ,"Spec. 1- L4" ,"Spec. 2- L5"
    ,"Spec. 3- L6" ,"Spec. 4- L7" ,"Spec. 5- L8" ,"Spec. 6- L9"
    ,"Spec. 7- L10" ,"Spec. 8- L11" ,"BOQ Spec1" ,"BOQ Spec2" ,"BOQ Spec3"
    ,"BOQ Spec4" ,"BOQ Spec5" ,"BOQ Spec6" ,"BOQ Spec7" ,"BOQ Spec8" ,"BOQ Spec9"
    ,"Work Master Code /w Description", "Description"// ,"입찰_물량산출식" ,"실행_물량산출식" ,"rIDX"
];
# ----------------------------------------

# group: Family Type 별 WM 코드 Revit 되먹임 (room 객체 제외)
# note: Revit에 있는 Family Type 항목만
uniqueItems_2 = List.UniqueItems(list=getParameterValueByName_3)
code_block_12 = CodeBlock(catSheetDatas=allTypes, UniqElemTypes=uniqueItems_2) { catSheetDatas; UniqElemTypes; }
code_block_13 = CodeBlock(uniqTypeNames=uniqueItems) { uniqTypeNames; }
valueAtKey = DesignScript.Builtin.Dictionary.ValueAtKey(dictionary=code_block_12.catSheetDatas, key=code_block_13)
byKeysValues = DesignScript.Builtin.Dictionary.ByKeysValues(keys=code_block_13, values=valueAtKey)
실행모드에_따라_wm_필터링 = Python(IN[0]=byKeysValues, IN[1]=code_block_10)  # CPython3
# ---------- 실행모드에_따라_wm_필터링.python (22 lines) ----------
# Load the Python Standard and DesignScript Libraries
import sys
import clr
clr.AddReference('ProtoGeometry')
from Autodesk.DesignScript.Geometry import *

# The inputs to this node will be stored as a list in the IN variables.
dataEnteringNode = IN
famTypeDicts = IN[0]
calcFormula = IN[1] + "_물량산출식"
# Place your code below this line

def filter_effWmSpecs(famTypeDicts):
    res = {}
    for k,v in famTypeDicts.items():
        wmSpecs = v["wmSpecs"]
        eff_wmSpecs = list(filter(lambda x: not x[calcFormula].startswith("_"),wmSpecs))
        v["wmSpecs"] = eff_wmSpecs
        res[k] = v
    return res
# Assign your output to the OUT variable.
OUT = filter_effWmSpecs(famTypeDicts)
# ----------------------------------------
code_block_14 = CodeBlock { "Q'ty Cal Type Tag"; }
get_WMCodesAndBriefSpec = Python(IN[0]=실행모드에_따라_wm_필터링, IN[1]=code_block_14, IN[2]=code_block_11)  # CPython3
# ---------- get_WMCodesAndBriefSpec.python (42 lines) ----------
# Load the Python Standard and DesignScript Libraries
import sys
import clr
clr.AddReference('ProtoGeometry')
from Autodesk.DesignScript.Geometry import *

# The inputs to this node will be stored as a list in the IN variables.
dataEnteringNode = IN
dict_aio = IN[0]
calType_header = IN[1]
wmSpecs_headers = IN[2]
# Place your code below this line
famTypes = list(dict_aio.items())
res_dict = {}


def find_WMspecsPerFamType_(k_v):
    k = k_v[0]
    wms = k_v[1]
    res = list(map(lambda x: x["wmSpecs"], wms))
    res_zeroless = list(map(lambda y: filter(lambda x: x!=0, y), res))
    joined_strs = list(map(lambda x: ' | '.join(x),res_zeroless))

    return k,joined_strs
    
def find_WMspecsPerFamType(k_v):
    k = k_v[0]
    wms = k_v[1]["wmSpecs"]
    res = list(zip(*map(lambda y: map(lambda x: x[y], wms), wmSpecs_headers)))
    res_zeroless = list(map(lambda y: filter(lambda x: x!=0, y), res))
    joined_strs = list(map(lambda x: ' | '.join(x),res_zeroless))
    return k,joined_strs

WMspecs = list(map(find_WMspecsPerFamType, famTypes))

for k,v in WMspecs:
    res_dict[k] = [dict_aio[k][calType_header]] + v



# Assign your output to the OUT variable.
OUT = res_dict
# ----------------------------------------
valueAtKey_2 = DesignScript.Builtin.Dictionary.ValueAtKey(dictionary=get_WMCodesAndBriefSpec, key=code_block_13)
code_block_15 = CodeBlock()
# ---------- code_block_15.designscript (14 lines) ----------
[
"H_Q'ty Cal Type Tag",
"H_WM Code_1",
"H_WM Code_2",
"H_WM Code_3",
"H_WM Code_4",
"H_WM Code_5",
"H_WM Code_6",
"H_WM Code_7",
"H_WM Code_8",
"H_WM Code_9",
"H_WM Code_10"
//H_WM Code_ 매개변수 20번까지 확장 필요
];
# ----------------------------------------
setParamElementTypes = Python(IN[0]=code_block_12.UniqElemTypes, IN[1]=valueAtKey_2, IN[2]=code_block_15)  # CPython3; frozen
# ---------- setParamElementTypes.python (36 lines) ----------
# Load the Python Standard and DesignScript Libraries
import sys
import clr
clr.AddReference('ProtoGeometry')
from Autodesk.DesignScript.Geometry import *

clr.AddReference("RevitNodes")
import Revit
from Revit.Elements import *

# The inputs to this node will be stored as a list in the IN variables.
dataEnteringNode = IN
elemTypes = IN[0]
WMs_perFamTyp = IN[1]
param_ListForWM = IN[2]

input_sets = list(zip(elemTypes, WMs_perFamTyp))

# Place your code below this line

def setParamAnElem(elem, paramNames, paramVals):
    effName_List = paramNames[:len(paramVals)]
    effVals_List = paramVals
    setForParam = list(zip(effName_List, effVals_List))
    res = list(map(lambda x: elem.SetParameterByName(x[0],x[1]), setForParam))
    
    return res


final = map(lambda x: setParamAnElem(x[0],param_ListForWM,x[1]), input_sets)


#res = elemT.GetParameterValueByName("Default Thickness")
# Assign your output to the OUT variable.
#OUT = input_sets
OUT = final
# ----------------------------------------

code_block_16 = CodeBlock(file_path=n1_family_list_경로_입력) { file_path; }
code_block_17 = CodeBlock(file_path=code_block_16) { file_path; }
code_block_18 = CodeBlock(i=importExcel) { i[2..16]; }

# group: 시트별 Quantity 열 인덱스 추출
code_block_19 = CodeBlock { "Quantity"; }
code_block_20 = CodeBlock { 1; }
getItemAtIndex = List.GetItemAtIndex(list=code_block_18@L3, index=code_block_20)
find_tgtColIDX = Python(IN[0]=code_block_19, IN[1]=getItemAtIndex)  # CPython3
# ---------- find_tgtColIDX.python (23 lines) ----------
# Load the Python Standard and DesignScript Libraries
import sys
import clr
clr.AddReference('ProtoGeometry')
from Autodesk.DesignScript.Geometry import *

# The inputs to this node will be stored as a list in the IN variables.
dataEnteringNode = IN
tgtStr = IN[0]
hdrs_list_sheets = IN[1]
# Place your code below this line

def find_tgtColIdx(tgtStr, hdrs_list_sheets):
    res = []
    for hdrs_list in hdrs_list_sheets:
        if hdrs_list[0]!="NO":
            col_idx = hdrs_list.index(tgtStr)
        else:
            col_idx = hdrs_list.index(tgtStr)+1
        res.append(col_idx)
    return res
# Assign your output to the OUT variable.
OUT = find_tgtColIdx(tgtStr, hdrs_list_sheets)
# ----------------------------------------

시트별_quantity_열_인덱스 = CodeBlock(i=find_tgtColIDX) { i; }
시트별_quantity_열_인덱스_2 = CodeBlock(i=시트별_quantity_열_인덱스) { i; }
시트별_quantity_열_인덱스_3 = CodeBlock(i=시트별_quantity_열_인덱스_2) { i; }
시트별_quantity_열_인덱스_4 = CodeBlock(i=시트별_quantity_열_인덱스_3) { i; }
code_block_21 = CodeBlock(execMode=n2_물량산출모드_입찰_실행) { execMode; }
n3_토공산출모드_온통_개별 = CustomSelection("온통터파기", items={온통터파기: "온통터파기", 개별터파기: "개별터파기"})  # "3. 토공산출모드(온통 / 개별)"; graph input
code_block_22 = CodeBlock(earthmode=n3_토공산출모드_온통_개별) { earthmode; }
select_fl = Levels("H.P.P")  # graph input
code_block_23 = CodeBlock(select_fl=select_fl) { select_fl; }
elevation = Level.Elevation(level=code_block_23)
code_block_24 = CodeBlock(i=importExcel) { i[16]; }
excel_data_dictionarization = Python(IN[0]=lang_mode_영_한_select, IN[1]=code_block_24, IN[2]=target_sheet_names)  # "Excel data dictionarization_ManualSheet"; CPython3
# ---------- excel_data_dictionarization.python (375 lines) ----------
# Load the Python Standard and DesignScript Libraries"
import sys
import clr
clr.AddReference('ProtoGeometry')
from Autodesk.DesignScript.Geometry import *

################Module For Functional Programing#########################
from functools import reduce
from itertools import chain
from itertools import groupby
from copy import deepcopy
curry = lambda f: lambda a,*args: f(a, *args) if (len(args)) else lambda *args: f(a, *args)

filter = curry(filter)
map = curry(map)
reduce = curry(reduce)

go = lambda *args: reduce(lambda a,f: f(a), args) ## 함수도 축약 가능 ##

def dictUpdate(dic1,dic2):
    res = dic1.update(dic2)
    return dic1
    
def dictsMerge(dics):
    res = reduce(dictUpdate, dics)
    return res
    
def dictDeleteKeys(dic, keys):
    for k in keys:
        del dic[k]
    return dic

def flat(a):
    if isinstance(a, list):
        for i in a: 
            yield from flat(i)
    else: yield a
#########################################################################

import re
from functools import partial

# The inputs to this node will be stored as a list in the IN variables.
dataEnteringNode = IN
lang_mode = IN[0]

manualSheet = IN[1]


#wmspec_headers = [
#    "Work Master Code" ,"GaugeCode" ,"Unit" ,"Work Category-L1"
#    ,"Work Category-L2" ,"Work Category-L3" ,"Spec. 1- L4" ,"Spec. 2- L5"
#    ,"Spec. 3- L6" ,"Spec. 4- L7" ,"Spec. 5- L8" ,"Spec. 6- L9"
#    ,"Spec. 7- L10" ,"Spec. 8- L11" ,"BOQ Spec1" ,"BOQ Spec2" ,"BOQ Spec3"
#    ,"BOQ Spec4" ,"BOQ Spec5" ,"BOQ Spec6" ,"BOQ Spec7" ,"BOQ Spec8" ,"BOQ Spec9"
#    ,"Work Master Code /w Description", "Description" ,"입찰_물량산출식" ,"실행_물량산출식" ,"rIDX"
#]
# Place your code below this line

def find_IsInStr(target, string):
    if target == None or string == None:
        pass
    else:
        res = str(target) in str(string)
        return res

def find_range_by_columnItem(db, col_idx, sep_rule):
    tdb = list(map(lambda x: x[col_idx], db)) ##targetTransposedDB (col_idx에 해당하는 데이터만 추출)
    last_idx_tdb = len(tdb)-1
    tdb_enum = enumerate(tdb)
    target_RowNumber = list(filter(lambda x: find_IsInStr(sep_rule, x[1]), tdb_enum))
    endidxs_tmp= list(map(lambda x: x[0]-1,target_RowNumber))
    endidxs_tmp.pop(0)
    endidxs = endidxs_tmp + [last_idx_tdb] ## 각 구간별 마지막 행 번호
    rangeSttIdxs = list(map(lambda x: x[0]+1,target_RowNumber))
    rangeEndIdxs = endidxs
    result = list(zip(rangeSttIdxs, rangeEndIdxs))
    return result

    
def find_headersAtSheet(sheet):
    headers_sheet = list(map(lambda x: [x[1].replace("\n",""),x[0]], filter(lambda x: x[1] != None, enumerate(sheet[1]))))
    
    return dict(headers_sheet)
    #return list(headers_sheet)

def find_rangesAtSheet(sheet, hdrs_withIdxDict, trgt_hdr, trgt_str):
    #hdrs_withIdxDict = dict(hdrs_withIdx)
    return find_range_by_columnItem(sheet, hdrs_withIdxDict[trgt_hdr], trgt_str)


def get_DataOnGrpsAtSheet(sheet:list, discrHDRStr, discrRowStr):
    """
    판별기준 Header문자열(discrHDRStr)이 들어있는 열에서,
    판별기준 행 문자열(discrRowStr)이 들어있는 행번호 기준으로 구역을 나누어 데이터 리스트 반환
    """
    hdrs_withIdxDict = find_headersAtSheet(sheet)

    # 시트별 그룹 구분 (시작 행번호, 끝 행 번호 추출)
    rowAreasAtSheet = find_rangesAtSheet(sheet, hdrs_withIdxDict, discrHDRStr, discrRowStr)
    
    # 시트 각행에 rIDX 데이터 주입하는 구간 - (시작) >>>>>>>
    ## 헤더의 칼럼 인덱스 중 가장 큰 것 추출
    hdrs_maxCol_idx = max(list(hdrs_withIdxDict.values()))
    ## 마지막 헤더위치보다 한칸 옆을 행인덱스번호("rIDX") 정보 보관 위치로 설정
    hdrs_withIdxDict["rIDX"] = hdrs_maxCol_idx+1
    ## 시트의 각 행을 번호와 함께 pair 형태로 추출
    sheetWith_rIDX = list(enumerate(sheet))
    ## rIDX 보관된 시트 데이터 저장을 위한 빈 리스트 선언
    sheet_rIDX = []
    ## pair 형태의 각 행에서, 마지막 헤더의 한칸 우측위치에 rIDX 데이터 주입
    ## 시트의 각 행마다 x 라는 이름으로 순회하며,
    for x in sheetWith_rIDX:
        ### 행의 전체 데이터 길이가 마지막 헤더 위치보다 클때,
        if len(x[1])-1>hdrs_maxCol_idx:
            #### 마지막 헤더의 우측 칸 위치를 rIDX 데이터로 치환
            x[1][hdrs_maxCol_idx+1] = x[0]
            sheet_rIDX.append(x[1])
            
        ### 행의 전체 데이터 길이가 마지막 헤더 위치와 같을때,
        else:
            #### 마지막 헤더의 우측칸이 없으므로 append로 rIDX 데이터 추가
            x[1].append(x[0])
            sheet_rIDX.append(x[1])
    # <<<<< 시트 각행에 rIDX 데이터 주입하는 구간 - (끝)
    
    rowsGrps_perType_withNone = list(map(lambda x: sheet_rIDX[x[0]-1:x[1]], rowAreasAtSheet))
    # None 데이터 치환 구간
    rowsListGrps_perType = go(#>
        rowsGrps_perType_withNone, list,
        ## 하나의 타입을 규정하는 행들의 모임에서
        map(lambda rowGrp: \
        ## 한 행씩 골라서
        list(map(lambda row: \
        ## 행을 구성하는 셀 값 중 None이 있으면 빈문자열로 치환
        list(map(lambda cell: "" if cell==None else cell, row)), rowGrp)) ),
        ## 맵 객체가 반환되므로 리스트 변환
        list,
    )#<
    
    return (rowsListGrps_perType, hdrs_withIdxDict)

def cvt_rowsListGrps_toDictGrps(rowsListGrps_perType, hdrs_withIdxDict, sheetName):
    """
    헤더 행과 다수의 컨텐츠 행으로 이루어진 rowListGrps를,
    모든 행을 헤더와 결합된 딕셔너리화 해서 rowDictGrps를 만드는 함수
    """
    eff_hdrs_idx = hdrs_withIdxDict.values()
    eff_hdrs_name = hdrs_withIdxDict.keys()
    
    rowsDictGrps_perType = go(#>
        rowsListGrps_perType,
        ## 하나의 타입을 규정하는 행들의 모임에서 한 행 씩 조작하는 함수들을 구상 후
        ## 맵 함수 내에서 go로 합성하여 반복시켜 사용
        map(lambda rowGrp: go(#>>
            ### 그룹 전체 가져와서
            rowGrp,
            ### 각 행을 리스트 타입으로 변환
            map(list), list,
            ### 헤더에 해당하는 행 값을 추출--
            map(lambda row: list(map(lambda idx: row[idx], eff_hdrs_idx))), list,
            ### 헤더이름과 행 내부의 값을 2개씩 짝지어 줌
            map(lambda row: list(zip(eff_hdrs_name, row))), list,
            ### 헤더이름 : 값의 형태로 각 행 데이터를 딕셔너리로 만듬
            map(lambda x: dict(x)),
            ### 딕셔너리 마다 카테고리 정보 추가
            map(lambda x: dictUpdate(x,{"Family Category":sheetName})),
            list,
            )#<<
        ), list,
    )#<
    return rowsDictGrps_perType

# 행딕셔너리 별 입력한 규칙에 따라 참거짓 여부를 반환하는 함수
def findRow_AppliedType(rowDict, tgtHDRname, rule=None):
    p = re.compile('[0-9]{3,5}')
    target = str(rowDict[tgtHDRname])
    ## 함수 호출시 구분자(rule) 없이 호출한 경우
    ## -Room Category 시트 용 이며 "Standard Type" 항목의 값이 000형태의 숫자인지를 판별
    ## -Room Category 중 "Standard Type" 칼럼에 룸 넘버, "Family Type Name" 칼럼에 룸 이름 입력하게 되어있음
    if rule==None:
        p = re.compile('[0-9]{3,5}')
        m = p.match(target)
        stdCase = target =="Room No"
        res = all([m or stdCase])
    ## 구분자(rule)가 정규표현식 객체로 들어온 경우
    elif isinstance(rule, re.Pattern):
        m = p.match(target)
        res = all([m])
    ## 구분자(rule)가 문자열로 들어온 경우
    else:
        res = rule in target
    return res

def find_stdWMdicts_inGrp(rowsDictGrp):
    res = go(
        rowsDictGrp, list,
        ## 엑셀 "물량산출식", "Work Master Code" 열에 값이 없는 행 제외
        filter(lambda rD: rD["입찰_물량산출식"] != "" and rD["실행_물량산출식"] != ""),
        filter(lambda rD: rD["Work Master Code"] != ""),
        filter(lambda rD: isinstance(rD["Work Master Code"], str)), ### 7/18 오류제보 반영
        ## Family Type Name에 "H_" 문자열 포함된 경우 제외
        filter(lambda rD: not findRow_AppliedType(rD, "Family Type Name", rule="H_")),
        ## 행 딕셔너리의 NO, Standard Type 업데이트
        map(lambda rD: dictUpdate(rD,{"NO":rowsDictGrp[0]["NO"], "Standard Type":rowsDictGrp[0]["Standard Type"]})),
        ## Q'ty Cal Type Tag 업데이트
        map(lambda rD: dictUpdate(rD,{"Q'ty Cal Type Tag":rowsDictGrp[0]["Q'ty Cal Type Tag"]})),
        list,
    )
    return res


def find_stdWMdicts_forCat(rowsDictsGrps):
    res = go(#>
        rowsDictsGrps, list,
        map(find_stdWMdicts_inGrp),
        #filter(lambda x: x!=[]),
        list,
    )#<
    return res

def find_appliedTypeDicts_forCat(rowsDictsGrps):
    catName = rowsDictsGrps[0][0]["Family Category"]
    eff_hdrs_name = list(rowsDictsGrps[0][0].keys())
    wmspec_headers = ["Family Category", "Work Master Code", "GaugeCode", "Unit"]\
        + list(filter(lambda x: "Work Cat" in x or "Spec" in x, eff_hdrs_name))\
        + ["Work Master Code /w Description", "Description","입찰_물량산출식", "실행_물량산출식", "rIDX"]
    #stdWMsDicts = find_stdWMdicts_forCat(rowsDictGrps)
    
    appliedTypeDicts = go(#>
        rowsDictsGrps,
        map(lambda rowsDictsGrp: go(#>>
            rowsDictsGrp, list,
            ## Family Type Name에 "H_" 문자열 포함된 경우만 필터링
            filter(lambda rD: findRow_AppliedType(rD, "Family Type Name", rule="H_")),
            ## 행 딕셔너리의 NO, Standard Type 업데이트 - 추후 함수 분리 염두
            map(lambda rD: dictUpdate(rD,{"NO":rowsDictsGrp[0]["NO"], "Standard Type":rowsDictsGrp[0]["Standard Type"]})),
            ## 그룹 첫행을 기준으로 Q'ty Cal Type Tag 업데이트 - 추후 함수 분리 염두
            map(lambda rD: dictUpdate(rD,{"Q'ty Cal Type Tag":rowsDictsGrp[0]["Q'ty Cal Type Tag"]})),
            
            # wmSpecs 속성들을 헤더로 하는 새로운 딕셔너리 형성 및 값 추가(값은 list형태)
            map(lambda rD: dictUpdate(rD, {"wmSpecs": go(
                ### wmspec관련 항목들 값을 리스트로 모음
                map(lambda x: rD[x], wmspec_headers), list,
                ### 항목명과 항목값을 모아서 딕셔너리 형태로 변환
                lambda x: zip(wmspec_headers,x), dict,
                ### wmSpecs 항목을 리스트 구조로 수정해 두기
                lambda x: [x] if x["Work Master Code"]!="" else [],
                
            )}) ),
            ## 밖으로 꺼내진 WorkMaster 관련 속성 삭제
            map(lambda rD: dictDeleteKeys(rD, wmspec_headers)), list,
            ## 각 딕셔너리마다 카테고리 명 입력
            #map(lambda rD: dictUpdate(rD, {"Family Category":catName})),
            list,
            )#<<
        ),
        # 실적용 패밀리타입이 없는 그룹은 제외하는 구간
        filter(lambda x: list(x)!=[]),
        list,
    )#<
    
    return appliedTypeDicts

def merge_sameFamType_wmSpecs(appliedTypeDicts):
    def merge_inGrp(appliedTypeDicts_perGrp):
        """
        엑셀 타입별 행그룹 내에서 실 적용 패일리명이 들어있는
        행들만 추출하고, 그 중 이름이 같은 것들의 wm 정보는 합쳐서
        하나의 이름에 하나의 딕셔너리 객체만 존재하도록 수정
        """
        ## 그룹 내 실 적용 패밀리 타입 명 추출(중복 불허)
        keysPerGrp = go(#>
            appliedTypeDicts_perGrp,
            ## 개별 행딕셔너리의 패밀리 타입 항목 값 추출
            map(lambda rD: rD["Family Type Name"]),
            ## 문자열 내 "H_"가 포함되어있는 지 검사
            filter(lambda x: "H_" in x),
            ## 중복 Family Type Name 단일화
            set, list,
        )#<
        ## 패밀리 타입 명을 k라는 변수명으로 하나씩 순회
        for k in keysPerGrp:
            ### k라는 패밀리 타입 명에 해당하는 딕셔너리 모두 검색
            sameNameDicts = list(filter(lambda x: x["Family Type Name"] == k, appliedTypeDicts_perGrp))
            ### 하나의 타입명에 복수 객체인지를 검사하여
            ### 2개 이상인 경우
            if len(sameNameDicts)>=2:
                ### 동일 이름의 딕셔너리들 중 첫번째 항목의 "wmSpecs"에
                ### 나머지 항목의 wmSpecs 항목을 몰아준다
                for i,rD in enumerate(sameNameDicts[1:]):
                    if rD["wmSpecs"]:
                        sameNameDicts[0]["wmSpecs"].append(*rD["wmSpecs"])
                    else: pass
                ### 몰아주기가 끝나면, 첫번째를 제외한 나머지 딕셔너리는
                ### 불필요해지므로 삭제
                appliedTypeDicts_perGrp.remove(sameNameDicts[i+1])
            else:                
                pass
        ## 수정된 딕셔너리들 리스트를 반환
        return appliedTypeDicts_perGrp
    # 단위 그룹에 대한 함수를 복수 그룹들 전체에 시행
    return map(merge_inGrp, appliedTypeDicts)

def inject_stdWMtoAppliedTypeDicts(appliedTypeDicts, allCat_stdWMdicts_stdTypeName):
    def inject_inGrp(appliedTypeDict_perGrp):
        """
        타입 그룹 별 공통 WM 딕셔너리 항목들을
        실적용패밀리 딕셔너리에 주입하는 함수
        """
        ## 실적용패밀리 딕셔너리 리스트의 구성 원소 각각을
        ## rD(rowDictionary) 라는 이름으로 순회
        for rD in appliedTypeDict_perGrp:
            ### rD의 "Standard Type" 항목 값이
            ### 입력받은 타입별 공통 WM항목 딕셔너리의 키값중에
            ### 포함되었는지 검사후 있으면,
            if rD["Standard Type"] in list(allCat_stdWMdicts_stdTypeName.keys()):
                #### rD의 "wmSpecs" 항목에 공통 WM항목을 추가하여 재할당
                rD["wmSpecs"] = rD["wmSpecs"] + allCat_stdWMdicts_stdTypeName[rD["Standard Type"]]
            else:
                pass
        ## 수정된 딕셔너리들 리스트를 반환
        return appliedTypeDict_perGrp
    # 단위 그룹에 대한 함수를 복수 그룹들 전체에 시행
    return list(map(inject_inGrp, appliedTypeDicts))

def matchWith_Elem_Dict(famlist_dic,revitElems):
    """
    레빗객체와 패밀리리스트 딕셔너리의 정보를 하나로 결합해주는 용도의 함수
    패밀리리스트 데이터는 패밀리 타입명을 키값으로 하는 하나의 딕셔너리로 정리되어있어야 한다
    revit객체는 패밀리리스트 상 존재하는 타입만 필터링해서 입력해야 함
    """
    # 수행결과를 모을 빈 리스트 선언
    res = []
    # 모든 레빗 객체들을 하나씩 순회 
    for i in revitElems:
        ## revit 객체들과 revit 타입별 Family List 딕셔너리를 결합하기 위한 빈 딕셔너리 선언
        combD = {}
        ## 패밀리 타입명 추출 - Room 객체인 경우와 아닌 경우 분기
        if "Room" in str(type(i)):
            famTypeName = i.GetParameterValueByName("Number") + "_" + i.GetParameterValueByName("Name")
        else:
            famTypeName = i.GetParameterValueByName("Type").GetParameterValueByName("Type Name")
        ## 결합용 딕셔너리의 "Elem" 이라는 키에 순회 중인 i (revit객체)를 할당
        combD["Elem"] = i
        combD["GUID"] = i.GetParameterValueByName("IfcGUID")
        ## 결합용 딕셔너리의 "wms" 이라는 키에 
        ## 순회 중인 i (revit객체) 패밀리 타입 명과 일치하는 famlist_dictionary의 값을 할당
        combD["wms"] = deepcopy(famlist_dic[famTypeName])
        ##결합된 딕셔너리를 res에 저장
        res.append(combD)
    # 전체 수행 결과 반환
    return res

def formToElemDictStyle(typeDictsGrps):
    res = []
    for typeDicts in typeDictsGrps:
        tmp = go(
            typeDicts,
            map(lambda x: {"wms": x, "Elem":"from_Manual_Input", "GUID": "from_Manual_Input"}),
            list,
        )
        res.append(tmp)
    return list(chain(*res))
    
manualSheet_rowsListGrps = get_DataOnGrpsAtSheet(manualSheet, "Standard Type", "H_")
manualSheet_rowsDictGrps = cvt_rowsListGrps_toDictGrps(*manualSheet_rowsListGrps, "13.Manual_Input")
manualSheet_appliedTypeDicts = find_appliedTypeDicts_forCat(manualSheet_rowsDictGrps)
manualSheet_appliedTypeDicts_noDupl = merge_sameFamType_wmSpecs(manualSheet_appliedTypeDicts)
#appliedTypeDicts_withStdWm = inject_stdWMtoAppliedTypeDicts(manualSheet_appliedTypeDicts_noDupl, {})


# Assign your output to the OUT variable.

OUT = formToElemDictStyle(manualSheet_appliedTypeDicts_noDupl)#, manualSheet_appliedTypeDicts_noDupl#
# ----------------------------------------

# group: Final Calculation
code_block_25 = CodeBlock(calcMode=n2_물량산출모드_입찰_실행) { calcMode; }
calcTypeDict_symValPair = CodeBlock(i=code_block_8) { i[2]; }
code_block_26 = CodeBlock(i=calcTypeDict_symValPair) { i["SF-Q0"]; }
토공_계산_1_1_3 = Python(IN[0]=code_block_21, IN[1]=code_block_22, IN[2]=allElemsDict, IN[3]=code_block_26, IN[4]=elevation)  # CPython3
# ---------- 토공_계산_1_1_3.python (580 lines) ----------
# Load the Python Standard and DesignScript Libraries
import sys
import clr
clr.AddReference('ProtoGeometry')
from Autodesk.DesignScript.Geometry import *

import Revit

################Module For Functional Programing##########################
from functools import reduce
from itertools import chain
from itertools import groupby
from copy import deepcopy
curry = lambda f: lambda a,*args: f(a, *args) if (len(args)) else lambda *args: f(a, *args)

filter = curry(filter)
map = curry(map)
reduce = curry(reduce)

go = lambda *args: reduce(lambda a,f: f(a), args) ## 함수도 축약 가능 ##

def dictUpdate(dic1,dic2):
    res = dic1.update(dic2)
    #res = {**dic1,**dic2}
    return dic1 #res
    
def dictsMerge(dics):
    res = reduce(dictUpdate, dics)
    return res
    
def dictDeleteKeys(dic, keys):
    for k in keys:
        del dic[k]
    return dic
##########################################################################

# The inputs to this node will be stored as a list in the IN variables.
dataEnteringNode = IN
calcMode = IN[0]
excaMode = IN[1]
elemDicts = IN[2]
earth_CommonInfoDict = IN[3]
GL = IN[4]
#test_sample = elemDicts[303]

# Place your code below this line
LD = earth_CommonInfoDict["LD"]
SurveyPoint_Z = Revit.Elements.Coordinates.SurveyPoint().Z
BasePoint_Z = Revit.Elements.Coordinates.BasePoint().Z

pjt_level_calibration = BasePoint_Z - SurveyPoint_Z

#GL = Revit.Elements.Coordinates.BasePoint().Z - LD * 1000
#GL = FL_Z - pjt_level_calibration - LD * 1000

GWL_ = earth_CommonInfoDict["GWL"] * 1000

GWL = earth_CommonInfoDict["GWL"] * 1000 - pjt_level_calibration

GWLplane = Plane.ByOriginNormal(Point.ByCoordinates(0,0,GWL_ + pjt_level_calibration), Vector.ByCoordinates(0,0,1))

def find_belowSrf_simple(elem):
    res = go(
        elem.Geometry(),
        map(BoundingBox.ByGeometry), map(BoundingBox.ToCuboid),
        map(lambda x: x.Explode()),
        lambda x: list(chain(*x)),
        filter(lambda x: x.NormalAtParameter(0.5,0.5).Z < -0.1),list,
    )
    if res:
        return res

def find_belowSrf_complex(elem):
    res = go(
        elem.Geometry(),
        #map(BoundingBox.ByGeometry), map(BoundingBox.ToCuboid),
        map(lambda x: x.Explode()),
        lambda x: list(chain(*x)),
        filter(lambda x: x.NormalAtParameter(0.5,0.5).Z < -0.1),list,
    )
    if res:
        return res
        
def find_aboveSrf_simple(elem):
    res = go(
        elem.Geometry(),
        map(BoundingBox.ByGeometry), map(BoundingBox.ToCuboid),
        map(lambda x: x.Explode()),
        lambda x: list(chain(*x)),
        filter(lambda x: x.NormalAtParameter(0.5,0.5).Z == 1),list,
    )
    if res:
        return res
        
def add_defaultEarthInfo(elemDict, GWL, GL, BasePoint_Calibration):
    elem = elemDict["Elem"]
    if "_ExcaTgt" in elemDict["wms"]["Family Type Name"]:
        btmSrfs = find_belowSrf_complex(elem)
        btmSrfs = btmSrfs if btmSrfs else []
    else:
        btmSrfs = find_belowSrf_simple(elem)
        btmSrfs = btmSrfs if btmSrfs else []
    uprSrfs = find_aboveSrf_simple(elem)
    uprSrfs = uprSrfs if uprSrfs else []
    
    try:    
        if "Lean" not in elemDict["wms"]["Family Type Name"]:
            leanThk = elemDict["wms"]["Post_Sym_Val Dict"]["C1"] * 1000
            baseThk = elemDict["wms"]["Post_Sym_Val Dict"]["C2"] * 1000
            subBaseThk = elemDict["wms"]["Post_Sym_Val Dict"]["C3"] * 1000
            extraThk = elemDict["wms"]["Post_Sym_Val Dict"]["C4"] * 1000
        else:
            leanThk  = 0
            baseThk = elemDict["wms"]["Post_Sym_Val Dict"]["C2"] * 1000
            subBaseThk = elemDict["wms"]["Post_Sym_Val Dict"]["C3"] * 1000
            extraThk = elemDict["wms"]["Post_Sym_Val Dict"]["C4"] * 1000
    except:
        leanThk  = 0
        baseThk = 0
        subBaseThk = 0
        extraThk = 0
        

    base_downHeight = leanThk + baseThk + subBaseThk + extraThk
    
    btmZ = min( list(map(lambda x: x.PointAtParameter(0.5,0.5).Z, btmSrfs))\
                        if btmSrfs else [0] ) - BasePoint_Calibration
    uprZ = max( list(map(lambda x: x.PointAtParameter(0.5,0.5).Z, uprSrfs))\
                        if uprSrfs else [0] ) - BasePoint_Calibration
    
    btmArea = sum(list(map(lambda x: x.Area, btmSrfs)))
    elem_Volume = btmArea * abs(uprZ - btmZ) / 1000000000
    Btm_toGWL_volume = btmArea * ( GWL - (btmZ - base_downHeight) ) / 1000000000
    GWL_toGL_volume = btmArea * ( GL - GWL ) / 1000000000
    Btm_toGL_volume = btmArea * ( GL - (btmZ - base_downHeight) ) / 1000000000
    
    res = {
        "isExca": False,
        "btmSrfs": btmSrfs,
        "uprSrfs": uprSrfs,
        "btmArea": btmArea,
        "btmZ": btmZ,
        "uprZ": uprZ,
        "elem_Volume": elem_Volume,
        "Btm_toGWL_volume": Btm_toGWL_volume\
                            if Btm_toGWL_volume > 0 else 0 ,
        "GWL_toGL_volume": GWL_toGL_volume\
                            if GWL_toGL_volume > 0 else 0 ,
        "Btm_toGL_volume": Btm_toGL_volume\
                            if Btm_toGL_volume > 0 else 0 ,
    }
    
    
    elemDict["earthInfo"] = res
    return elemDict

def filter_EarthworkCalcTarget(elemDicts, GWL, GL, BasePoint_Calibration):
    ruleCondition = lambda x:\
        "H1_" in x["wms"]["Family Type Name"] or\
        "S18_Shallow" in x["wms"]["Family Type Name"] or\
        "S18_W" in x["wms"]["Family Type Name"] or\
        "S18_MAT" in x["wms"]["Family Type Name"] or\
        "B01_MAT" in x["wms"]["Family Type Name"] or\
        "S18_Wall" in x["wms"]["Family Type Name"] or\
        "B01" in x["wms"]["Family Type Name"] or\
        "B08_UG RC Slab" in x["wms"]["Family Type Name"] or\
        "B08_Ext Wall_RC_UG_Pit" in x["wms"]["Family Type Name"] or\
        "S16_UG" in x["wms"]["Family Type Name"] or\
        "S16_TG" in x["wms"]["Family Type Name"] or\
        "S17_SOG" in x["wms"]["Family Type Name"] or\
        "S17_Gr" in x["wms"]["Family Type Name"] or\
        "S17_EQ-Pad" in x["wms"]["Family Type Name"] or\
        "S17_Edge" in x["wms"]["Family Type Name"] or\
        "S17_Suspend" in x["wms"]["Family Type Name"] or\
        "S15_UG" in x["wms"]["Family Type Name"] or\
        "B08_Stoop" in x["wms"]["Family Type Name"] or\
        "B08_Ramp" in x["wms"]["Family Type Name"] or\
        "_ExcaTgt" in x["wms"]["Family Type Name"]
    res = go(
        elemDicts,
        filter(lambda x: ruleCondition(x)),
        map( lambda x: add_defaultEarthInfo(x, GWL, GL, BasePoint_Calibration) ),
        list,
    )
    remain = go(
        elemDicts,
        filter(lambda x: not ruleCondition(x)),
        list,
    )
    return res, remain


def filter_ExcaTarget(earthworkCalcTargets):
    res = go(
        earthworkCalcTargets,
        filter(lambda x:
            "B08_Ext Wall" not in x["wms"]["Family Type Name"] and
            "B02_Ext Wall" not in x["wms"]["Family Type Name"] and
            "S15_UG" not in x["wms"]["Family Type Name"]
        ),
        list,
    )
    for x in res:
        x["earthInfo"]["isExca"] = True
    return res


def find_eachExcaShape(elemDict, GWL, GL, LD, BasePoint_Calibration):
    belowSrfs = elemDict["earthInfo"]["btmSrfs"]
    btm_GL_Z = elemDict["earthInfo"]["btmZ"]
    G = elemDict["wms"]["Post_Sym_Val Dict"]["G"]
    GL_FL_gap = LD
    
    if "Lean" not in elemDict["wms"]["Family Type Name"]:
        leanThk = elemDict["wms"]["Post_Sym_Val Dict"]["C1"] * 1000
    else:
        leanThk  = 0
        
    baseThk = elemDict["wms"]["Post_Sym_Val Dict"]["C2"] * 1000
    subBaseThk = elemDict["wms"]["Post_Sym_Val Dict"]["C3"] * 1000
    extraThk = elemDict["wms"]["Post_Sym_Val Dict"]["C4"] * 1000
    base_downHeight = leanThk + baseThk + subBaseThk + extraThk
    
    if btm_GL_Z < -0.1:
        excaHeight = (-btm_GL_Z + base_downHeight)
    else:
        excaHeight = base_downHeight
        
    leanOffset = elemDict["wms"]["Post_Sym_Val Dict"]["D1"] * 1000
    excaOffset = elemDict["wms"]["Post_Sym_Val Dict"]["D2"] * 1000
    belowOffset = leanOffset + excaOffset
    #upperOffset = G * excaHeight
    upperOffset = G * excaHeight + belowOffset
    
    find_belowRef = lambda belowSrf: go(
        belowSrf,
        lambda x: x.Translate(0, 0, -base_downHeight),
        lambda x: x.PerimeterCurves(),
        PolyCurve.ByJoinedCurves,
        lambda x: x.OffsetMany(-belowOffset, False, Vector.ZAxis()),
        lambda x: x[0],
        Surface.ByPatch,
        BoundingBox.ByGeometry,
        lambda x: [x.MinPoint, x.MaxPoint],
        lambda x: Cuboid.ByCorners(*x),
        lambda x: x.Explode()[0],
        lambda x: x.PerimeterCurves(),
        PolyCurve.ByJoinedCurves,
    )
    
    find_upperRef = lambda belowSrf: go(
        belowSrf,
        lambda x: x.Translate(0, 0, -btm_GL_Z - LD*1000),
        lambda x: x.PerimeterCurves(),
        PolyCurve.ByJoinedCurves,
        lambda x: x.OffsetMany(-upperOffset, False, Vector.ZAxis()),
        lambda x: x[0],
        Surface.ByPatch,
        BoundingBox.ByGeometry,
        lambda x: [x.MinPoint, x.MaxPoint],
        lambda x: Cuboid.ByCorners(*x),
        lambda x: x.Explode()[0],
        lambda x: x.PerimeterCurves(),
        PolyCurve.ByJoinedCurves,
    )
    
    belowRefs = list(map(find_belowRef, belowSrfs))
    upperRefs = list(map(find_upperRef, belowSrfs))
    exca_RefGroups = list(zip(belowRefs,upperRefs))
    exca_Shape = Solid.ByUnion( map(Solid.ByLoft, exca_RefGroups) )
    
    return exca_Shape

def find_unionExcaShape(excaTargets, GWL, GL, LD, BasePoint_Calibration):
    excaSolids = []
    for elemDict in excaTargets:
        excaSolids.append( find_eachExcaShape(elemDict, GWL, GL, LD, BasePoint_Calibration) )
        res = Solid.ByUnion(excaSolids)
    return res
    
def find_unionExcaShape_whole(
        excaTargets, 
        GWL, 
        GL, 
        LD, 
        earth_CommonInfoDict, 
        pjt_level_calibration
    ):
    
    allElems = list(map(lambda x: x["Elem"], excaTargets))
    def makeBdCube(e):
        eGeo = e.Geometry()[0]
        eBdBoxCube = BoundingBox.ByGeometry(eGeo).ToCuboid()
        return eBdBoxCube
    
    def find_elemsGeo(allElems):
        #flatten_Elems = list(chain(*excaTargets))
        allGeo = []
        for e in allElems:
            try:
                allGeo.append(makeBdCube(e))
            except:
                pass
        return allGeo
        
    def findWholeBdBox(allElems):
        allGeo = find_elemsGeo(allElems)
        unionBdCube = BoundingBox.ByGeometry(allGeo).ToCuboid()
        return unionBdCube
    
    find_belowRef = lambda belowSrf: go(
        belowSrf,
        lambda x: x.Translate(0, 0, -base_downHeight),
        lambda x: x.PerimeterCurves(),
        PolyCurve.ByJoinedCurves,
        lambda x: x.OffsetMany(-belowOffset, False, Vector.ZAxis()),
        lambda x: x[0],
        Surface.ByPatch,
        BoundingBox.ByGeometry,
        lambda x: [x.MinPoint, x.MaxPoint],
        lambda x: Cuboid.ByCorners(*x),
        lambda x: x.Explode()[0],
        lambda x: x.PerimeterCurves(),
        PolyCurve.ByJoinedCurves,
    )
    
    find_upperRef = lambda belowSrf: go(
        belowSrf,
        lambda x: x.Translate(0, 0, -btm_GL_Z - LD*1000),
        lambda x: x.PerimeterCurves(),
        PolyCurve.ByJoinedCurves,
        lambda x: x.OffsetMany(-upperOffset, False, Vector.ZAxis()),
        lambda x: x[0],
        Surface.ByPatch,
        BoundingBox.ByGeometry,
        lambda x: [x.MinPoint, x.MaxPoint],
        lambda x: Cuboid.ByCorners(*x),
        lambda x: x.Explode()[0],
        lambda x: x.PerimeterCurves(),
        PolyCurve.ByJoinedCurves,
    )

    unionBdCube = findWholeBdBox(allElems)
    belowSrfs = go(
        [unionBdCube],
        map(BoundingBox.ByGeometry), map(BoundingBox.ToCuboid),
        map(lambda x: x.Explode()),
        lambda x: list(chain(*x)),
        filter(lambda x: x.NormalAtParameter(0.5,0.5).Z < -0.1),list,
    )
    
    btm_GL_Z = min( list(map(lambda x: x.PointAtParameter(0.5,0.5).Z, belowSrfs))\
                        if belowSrfs else [0] ) - pjt_level_calibration

    G = earth_CommonInfoDict["G"]
    GL_FL_gap = LD
    leanThk = earth_CommonInfoDict["C1"] * 1000
    baseThk = earth_CommonInfoDict["C2"] * 1000
    subBaseThk = earth_CommonInfoDict["C3"] * 1000
    extraThk = earth_CommonInfoDict["C4"] * 1000
    base_downHeight = leanThk + baseThk + subBaseThk + extraThk
    excaHeight = -btm_GL_Z + base_downHeight
    leanOffset = earth_CommonInfoDict["D1"] * 1000
    excaOffset = earth_CommonInfoDict["D2"] * 1000
    belowOffset = leanOffset + excaOffset
    #upperOffset = G * excaHeight
    upperOffset = G * excaHeight + belowOffset

    belowRefs = list(map(find_belowRef, belowSrfs))
    upperRefs = list(map(find_upperRef, belowSrfs))
    exca_RefGroups = list(zip(belowRefs,upperRefs))
    exca_Shape = Solid.ByUnion( map(Solid.ByLoft, exca_RefGroups) )
    
    return exca_Shape
    
def find_disposalShape(elemDict):
#    elemDisposal_shape = Solid.ByUnion(list(elemDict["Elem"].Geometry()))
    elemDisposal_shape = BoundingBox.ByMinimumVolume(
        [Solid.ByUnion(list(elemDict["Elem"].Geometry()))]
    ).ToCuboid()
    
    leanThk = elemDict["wms"]["Post_Sym_Val Dict"]["C1"] * 1000
    baseThk = elemDict["wms"]["Post_Sym_Val Dict"]["C2"] * 1000
    subBaseThk = elemDict["wms"]["Post_Sym_Val Dict"]["C3"] * 1000
    extraThk = elemDict["wms"]["Post_Sym_Val Dict"]["C4"] * 1000
    base_downHeight = leanThk + baseThk + subBaseThk + extraThk
    
    belowSrfs = elemDict["earthInfo"]["btmSrfs"]
    offset = elemDict["wms"]["Post_Sym_Val Dict"]["D1"]*1000\
                + (elemDict["wms"]["Post_Sym_Val Dict"]["D2"]/2) *1000
    
    find_nonElemDisposal_belowRefs = lambda belowSrf: go(
        belowSrf,
        lambda x: x.Translate(0, 0, -base_downHeight),
        lambda x: x.PerimeterCurves(),
        PolyCurve.ByJoinedCurves,
        lambda x: x.OffsetMany(-offset, False, Vector.ZAxis()),
        lambda x: x[0],
        Surface.ByPatch,
        BoundingBox.ByGeometry,
        lambda x: [x.MinPoint, x.MaxPoint],
        lambda x: Cuboid.ByCorners(*x),
        lambda x: x.Explode()[0],
        lambda x: x.PerimeterCurves(),
        PolyCurve.ByJoinedCurves,
    )
    find_nonElemDisposal_upperRefs = lambda belowSrf: go(
        belowSrf,
        lambda x: x.PerimeterCurves(),
        PolyCurve.ByJoinedCurves,
        lambda x: x.OffsetMany(-offset, False, Vector.ZAxis()),
        lambda x: x[0],
        Surface.ByPatch,
        BoundingBox.ByGeometry,
        lambda x: [x.MinPoint, x.MaxPoint],
        lambda x: Cuboid.ByCorners(*x),
        lambda x: x.Explode()[0],
        lambda x: x.PerimeterCurves(),
        PolyCurve.ByJoinedCurves,
    )

    nonElemDisposal_belowRefs = list(map(find_nonElemDisposal_belowRefs, belowSrfs))
    nonElemDisposal_upperRefs = list(map(find_nonElemDisposal_upperRefs, belowSrfs))
    nonElemDisposal_RefGroups = list(zip(nonElemDisposal_belowRefs,nonElemDisposal_upperRefs))
    nonElemDisposal_Shape = Solid.ByUnion( map(Solid.ByLoft, nonElemDisposal_RefGroups) )
    disposal_shape = Solid.ByUnion( [elemDisposal_shape, nonElemDisposal_Shape] )
    
    return disposal_shape

def find_unionDisposalShape(earthCalcTargets):
    disposal_Solids = []
    for elemDict in earthCalcTargets:
        disposal_Solids.append( find_disposalShape(elemDict) )
        try:
            disposal_Solids.append( find_disposalShape(elemDict) )
        except:
            pass

    return Solid.ByUnion(disposal_Solids)
    
def add_dispoAndbackfill_qty_toElemDicts(earthCalcTargets, unionDisposalShape, unionBackfillShape):
    whole_disposalShape_volume = unionDisposalShape.Volume
    whole_backfillShape_volume = unionBackfillShape.Volume
    target = earthCalcTargets
    
    total_toGLvolume = go(
        target,
        map(lambda x: x["earthInfo"]["Btm_toGL_volume"]),
        sum,
    )
    
    def find_asignedQty_elemDict(d, wholeVolume):
        res = go(
            d,
            lambda x: (x["earthInfo"]["Btm_toGL_volume"] / total_toGLvolume) * wholeVolume,
            lambda x: x / 1000000000,
        )
        return res
     
    res = go(
        target,
        map( lambda x: 
            dict( x, **{"earthQty": {
                                        "disposal": find_asignedQty_elemDict(x, whole_disposalShape_volume),
                                        "backfill": find_asignedQty_elemDict(x, whole_backfillShape_volume),
                                    }} ) 
        ),
        list,
    )
    return res
    
def add_above_excavation_qty_toElemDicts(elemDicts, above_GWL_excaShape, below_GWL_excaShape):
    cond_inter_GWL = lambda x: x["earthInfo"]["Btm_toGWL_volume"] != 0 and \
                    x["earthInfo"]["Btm_toGWL_volume"] < x["earthInfo"]["elem_Volume"]
    cond_above_GWL = lambda x: x["earthInfo"]["Btm_toGWL_volume"] == 0
    cond_below_GWL = lambda x: x["earthInfo"]["Btm_toGWL_volume"] != 0 and \
                    x["earthInfo"]["Btm_toGWL_volume"] >= x["earthInfo"]["elem_Volume"]
    
    total_Btm_toGL_volume  = go(
        elemDicts,
        filter(lambda elemDict: elemDict["earthInfo"]["isExca"]),
        filter( lambda elemDict: cond_above_GWL(elemDict) ),
        map(lambda elemDict: elemDict["earthInfo"]["Btm_toGL_volume"]),
        sum,
    )
    total_GWL_toGL_volume  = go(
        elemDicts,
        filter(lambda elemDict: elemDict["earthInfo"]["isExca"]),
        filter( lambda elemDict: cond_inter_GWL(elemDict) or cond_below_GWL(elemDict) ),
        map(lambda elemDict: elemDict["earthInfo"]["GWL_toGL_volume"]),
        sum,
    )
    total_ref_volume = total_Btm_toGL_volume + total_GWL_toGL_volume
    exca_above_total_volume = above_GWL_excaShape.Volume
    exca_below_total_volume = below_GWL_excaShape.Volume
    
    def find_asignedQty_elemDict(elemDict):
        if elemDict["earthInfo"]["isExca"] and cond_inter_GWL(elemDict):
            elemDict["earthQty"]["exca_above"] = ( exca_above_total_volume * (elemDict["earthInfo"]["GWL_toGL_volume"] / total_ref_volume) ) / 1000000000
        elif elemDict["earthInfo"]["isExca"] and cond_above_GWL(elemDict):
            elemDict["earthQty"]["exca_above"] = ( exca_above_total_volume * (elemDict["earthInfo"]["Btm_toGL_volume"] / total_ref_volume) ) / 1000000000
        else:
            elemDict["earthQty"]["exca_above"] = 0.0
        return elemDict
    res = list(map( lambda x: find_asignedQty_elemDict(x), elemDicts ))
    return res

def add_below_excavation_qty_toElemDicts(elemDicts, above_GWL_excaShape, below_GWL_excaShape):
    cond_belowOrInter_GWL = lambda x: x["earthInfo"]["Btm_toGWL_volume"] != 0
    
    total_Btm_toGWL_volume  = go(
        elemDicts,
        filter(lambda elemDict: elemDict["earthInfo"]["isExca"]),
        filter( lambda elemDict: cond_belowOrInter_GWL(elemDict) ),
        map(lambda elemDict: elemDict["earthInfo"]["Btm_toGWL_volume"]),
        sum,
    )
    total_ref_volume = total_Btm_toGWL_volume
    exca_above_total_volume = above_GWL_excaShape.Volume
    exca_below_total_volume = below_GWL_excaShape.Volume
    
    def find_asignedQty_elemDict(elemDict):
        if elemDict["earthInfo"]["isExca"] and cond_belowOrInter_GWL(elemDict):
            elemDict["earthQty"]["exca_below"] = exca_below_total_volume/1000000000 * (elemDict["earthInfo"]["Btm_toGWL_volume"] / total_ref_volume)
        else:
            elemDict["earthQty"]["exca_below"] = 0.0
        return elemDict
    res = list(map( lambda x: find_asignedQty_elemDict(x), elemDicts ))
    return res


earthCalcTargets, remainElemDicts = filter_EarthworkCalcTarget(elemDicts, GWL, GL, pjt_level_calibration)
excaTargets = filter_ExcaTarget(earthCalcTargets)

# Assign your output to the OUT variable.

if excaMode == "개별터파기":
    unionExcaShape = find_unionExcaShape(excaTargets, GWL, GL, LD, pjt_level_calibration)
    unionPreDisposalShape = find_unionDisposalShape(earthCalcTargets)
    unionBackfillShape = unionExcaShape.Split(unionPreDisposalShape)[0]
    unionBackfillShape_volume = unionBackfillShape.Volume
    unionDisposalShape = unionExcaShape.Split(unionPreDisposalShape)[1]
    
    if isinstance(unionExcaShape, list) and len(unionExcaShape) ==2:
        above_GWL_excaShape, below_GWL_excaShape = unionExcaShape.Split(GWLplane)
        earthCalcTargets_dispoAndbackfill = add_dispoAndbackfill_qty_toElemDicts(earthCalcTargets, unionDisposalShape, unionBackfillShape)
        earthCalcTargets_aboveExca = add_above_excavation_qty_toElemDicts(earthCalcTargets_dispoAndbackfill, above_GWL_excaShape, below_GWL_excaShape)
        earthCalcTargets_calcFinshed = add_below_excavation_qty_toElemDicts(earthCalcTargets_aboveExca, above_GWL_excaShape, below_GWL_excaShape)
        
        OUT = [earthCalcTargets_calcFinshed + remainElemDicts, unionBackfillShape]
        #OUT = 0
    else:
        above_GWL_excaShape = unionExcaShape
        earthCalcTargets_dispoAndbackfill = add_dispoAndbackfill_qty_toElemDicts(earthCalcTargets, unionDisposalShape, unionBackfillShape)
        earthCalcTargets_aboveExca = add_above_excavation_qty_toElemDicts(earthCalcTargets_dispoAndbackfill, above_GWL_excaShape, above_GWL_excaShape)
        OUT = [earthCalcTargets_aboveExca + remainElemDicts, unionBackfillShape]
        #OUT = unionPreDisposalShape


elif excaMode == "온통터파기":
    unionExcaShape = find_unionExcaShape_whole(excaTargets, GWL, GL, LD, earth_CommonInfoDict, pjt_level_calibration)
    unionPreDisposalShape = find_unionDisposalShape(earthCalcTargets)
    unionBackfillShape = unionExcaShape.Split(unionPreDisposalShape)[0]
    unionBackfillShape_volume = unionBackfillShape.Volume
    unionDisposalShape = unionExcaShape.Split(unionPreDisposalShape)[1]
    unionDisposalShape_volume = unionDisposalShape.Volume
    
    if isinstance(unionExcaShape, list) and len(unionExcaShape) ==2:
        above_GWL_excaShape, below_GWL_excaShape = unionExcaShape.Split(GWLplane)
        earthCalcTargets_dispoAndbackfill = add_dispoAndbackfill_qty_toElemDicts(earthCalcTargets, unionDisposalShape, unionBackfillShape)
        earthCalcTargets_aboveExca = add_above_excavation_qty_toElemDicts(earthCalcTargets_dispoAndbackfill, above_GWL_excaShape, below_GWL_excaShape)
        earthCalcTargets_calcFinshed = add_below_excavation_qty_toElemDicts(earthCalcTargets_aboveExca, above_GWL_excaShape, below_GWL_excaShape)
        
        OUT = [earthCalcTargets_calcFinshed + remainElemDicts, unionBackfillShape]
    else:
        above_GWL_excaShape = unionExcaShape
        earthCalcTargets_dispoAndbackfill = add_dispoAndbackfill_qty_toElemDicts(earthCalcTargets, unionDisposalShape, unionBackfillShape)
        earthCalcTargets_aboveExca = add_above_excavation_qty_toElemDicts(earthCalcTargets_dispoAndbackfill, above_GWL_excaShape, above_GWL_excaShape)
        OUT = [earthCalcTargets_aboveExca + remainElemDicts, unionBackfillShape]
        
# ----------------------------------------
code_block_27 = CodeBlock(i=토공_계산_1_1_3) { i[1]; i[0]; i[0][45]; }
토공관련_wm들_물량산출_수식_처리구간 = Python(IN[0]=code_block_27.out1)  # CPython3
# ---------- 토공관련_wm들_물량산출_수식_처리구간.python (88 lines) ----------
# Load the Python Standard and DesignScript Libraries
import sys
import clr
clr.AddReference('ProtoGeometry')
from Autodesk.DesignScript.Geometry import *

################Module For Functional Programing##########################
from functools import reduce
from itertools import chain
from itertools import groupby
from copy import deepcopy
curry = lambda f: lambda a,*args: f(a, *args) if (len(args)) else lambda *args: f(a, *args)

filter = curry(filter)
map = curry(map)
reduce = curry(reduce)

go = lambda *args: reduce(lambda a,f: f(a), args) ## 함수도 축약 가능 ##

def dictUpdate(dic1,dic2):
    res = dic1.update(dic2)
    #res = {**dic1,**dic2}
    return dic1 #res
    
def dictsMerge(dics):
    res = reduce(dictUpdate, dics)
    return res
    
def dictDeleteKeys(dic, keys):
    for k in keys:
        del dic[k]
    return dic
##########################################################################

# The inputs to this node will be stored as a list in the IN variables.
dataEnteringNode = IN
elemDicts = IN[0]
#test_sample = elemDicts[303]

# Place your code below this line

def tmp_switchEarthworkFormula(elemDict):
    
    for i in elemDict["wms"]["wmSpecs"]:
        calcFormulas = filter(lambda x: "산출식" in x ,list(i.Keys))
        for k in calcFormulas:
            if i[k] in ["=Exca", "=Back", "=Disp"]:
                i[k] = "_tbd"
        
    return elemDict

def tmp_switchEarthworkFormula_allDicts(elemDicts):
    return list(map(tmp_switchEarthworkFormula, elemDicts))

def switchEarthworkFormula(elemDict):
    for i in elemDict["wms"]["wmSpecs"]:
        calcFormulas = filter(lambda x: "산출식" in x ,list(i.Keys))
        for k in calcFormulas:
            if i[k] == "=Exca" and "Above" in i["Spec. 7- L10"]:
                try:
                    i[k] = f'= {elemDict["earthQty"]["exca_above"]}'
                except:
                    i[k] = f'= 0'
                
            elif i[k] == "=Exca" and "Below" in i["Spec. 7- L10"]:
                try:
                    i[k] = f'= {elemDict["earthQty"]["exca_below"]}'
                except:
                    i[k] = f'= 0'
                
            elif i[k] == "=Back":
                try:
                    i[k] = f'= {elemDict["earthQty"]["backfill"]}'
                except:
                    i[k] = f'= 0'
                
            elif i[k] == "=Disp":
                try:
                    i[k] = f'= {elemDict["earthQty"]["disposal"]}'
                except:
                    i[k] = f'= 0'
    
    return elemDict

def switchEarthworkFormula_allDicts(elemDicts):
    return list(map(switchEarthworkFormula, elemDicts))
# Assign your output to the OUT variable.
OUT = switchEarthworkFormula_allDicts(elemDicts)
# ----------------------------------------
매뉴얼_시트_물량산출_수식_처리구간 = Python(IN[0]=excel_data_dictionarization)  # CPython3
# ---------- 매뉴얼_시트_물량산출_수식_처리구간.python (70 lines) ----------
# Load the Python Standard and DesignScript Libraries
import sys
import clr
clr.AddReference('ProtoGeometry')
from Autodesk.DesignScript.Geometry import *

################Module For Functional Programing#########################
from functools import reduce
from itertools import chain
from itertools import groupby
from copy import deepcopy
curry = lambda f: lambda a,*args: f(a, *args) if (len(args)) else lambda *args: f(a, *args)

filter = curry(filter)
map = curry(map)
reduce = curry(reduce)

go = lambda *args: reduce(lambda a,f: f(a), args) ## 함수도 축약 가능 ##

def dictUpdate(dic1,dic2):
    res = dic1.update(dic2)
    return dic1
    
def dictsMerge(dics):
    res = reduce(dictUpdate, dics)
    return res
    
def dictDeleteKeys(dic, keys):
    for k in keys:
        del dic[k]
    return dic

def flat(a):
    if isinstance(a, list):
        for i in a: 
            yield from flat(i)
    else: yield a
#########################################################################
# The inputs to this node will be stored as a list in the IN variables.
dataEnteringNode = IN
manualDicts = IN[0]
# Place your code below this line
def filter_noFormulaWM(manualDict):
    cond = lambda x:\
            x["입찰_물량산출식"].startswith("=") or\
            x["실행_물량산출식"].startswith("=")
    wms = manualDict["wms"]
#    for wm in wms:
    wmSpecs = wms["wmSpecs"]
    filtered_wmSpecs = go(
        wmSpecs,
        filter(lambda x: cond(x) ),
        list,
    )
    wms["wmSpecs"] = filtered_wmSpecs
    manualDict["wms"]["wmSpecs"] = filtered_wmSpecs
    return manualDict

def filter_noWmSpecs(manualDicts):    
    res = go(
        manualDicts,
        filter(lambda x: len(x["wms"]["wmSpecs"]) != 0),
        list,
    )

    return res
    
filtered_manualDicts = list(map(filter_noFormulaWM, manualDicts))
# Assign your output to the OUT variable.
OUT = filter_noWmSpecs(filtered_manualDicts)
# ----------------------------------------
join_4 = List.Join(list0=토공관련_wm들_물량산출_수식_처리구간, list1=매뉴얼_시트_물량산출_수식_처리구간)
부재_wm_별_산식에_의한_최종_계산 = Python(IN[0]=code_block_25, IN[1]=join_4)  # CPython3
# ---------- 부재_wm_별_산식에_의한_최종_계산.python (108 lines) ----------
# Load the Python Standard and DesignScript Libraries
import sys
import clr

clr.AddReference('RevitAPI')
from Autodesk.Revit.DB import *
import Autodesk

clr.AddReference('RevitNodes')
import Revit
clr.ImportExtensions(Revit.Elements)

clr.AddReference('RevitServices')
import RevitServices
from RevitServices.Persistence import DocumentManager
from RevitServices.Transactions import TransactionManager
doc = DocumentManager.Instance.CurrentDBDocument
uiapp = DocumentManager.Instance.CurrentUIApplication
app = uiapp.Application
#collector1 = FilteredElementCollector(doc)

clr.AddReference('ProtoGeometry')
from Autodesk.DesignScript.Geometry import *

################Module For Functional Programing##########################
from functools import reduce
from itertools import chain
from itertools import groupby
from copy import deepcopy
curry = lambda f: lambda a,*args: f(a, *args) if (len(args)) else lambda *args: f(a, *args)

filter = curry(filter)
map = curry(map)
reduce = curry(reduce)

go = lambda *args: reduce(lambda a,f: f(a), args) ## 함수도 축약 가능 ##

def dictUpdate(dic1,dic2):
    res = dic1.update(dic2)
    #res = {**dic1,**dic2}
    return dic1 #res
    
def dictsMerge(dics):
    res = reduce(dictUpdate, dics)
    return res
    
def dictDeleteKeys(dic, keys):
    for k in keys:
        del dic[k]
    return dic
##########################################################################
# The inputs to this node will be stored as a list in the IN variables.
dataEnteringNode = IN

calcMode = IN[0]
elemDicts = IN[1]


# Place your code below this line

def calcFormula_each_WmSpecs(elemDicts, calcMode):
    calc_key = "실행_물량산출식" if calcMode=="실행" else "입찰_물량산출식"
    
    def calcFormula_dict(d):
        e = d["Elem"]
        wmSpecss = d["wms"]["wmSpecs"]
        if "Post_Sym_Val Dict" in d["wms"].Keys:
            postSymValDict = d["wms"]["Post_Sym_Val Dict"]
            Sym_Vals = list(zip(postSymValDict.Keys, list(map(str, postSymValDict.Values))))
            sortedSym_Vals = sorted(Sym_Vals, key=lambda x: len(x[0]), reverse=True)
            for i in wmSpecss:
                applyFormula = str( i[calc_key] )
                if not applyFormula.startswith('_'):
                    substFormula = applyFormula
                    for x in sortedSym_Vals:
                        substFormula = substFormula.replace(*x)
                    i["applyFormula"] = "'"+ applyFormula
                    i["substFormula"] = "'"+ substFormula
                    try:
                        i["Quantity"] = round(eval(substFormula.strip('=')),3)
                    except:
                        i["Quantity"] = "'"+ substFormula
                else:
                    i["applyFormula"] = "'"+ applyFormula
                    i["substFormula"] = "'"+ applyFormula
                    i["Quantity"] = ""
        else:
            for i in wmSpecss:
                try:
                    applyFormula = str( i[calc_key] )
                    substFormula = applyFormula
                    i["applyFormula"] = "'"+ applyFormula
                    i["substFormula"] = "'"+ substFormula
                    i["Quantity"] = round(eval(substFormula.strip('=')),3)
                except:
                    i["Quantity"] = 0
        return d
    res = []
    for d in elemDicts:
        res.append(calcFormula_dict(d))
    
    return res




# Assign your output to the OUT variable.
OUT = calcFormula_each_WmSpecs(elemDicts, calcMode)
# ----------------------------------------
토공관련_wm들_물량산출_수식_임시처리구간 = Python(IN[0]=토공_계산_1_1_3)  # CPython3; frozen
# ---------- 토공관련_wm들_물량산출_수식_임시처리구간.python (56 lines) ----------
# Load the Python Standard and DesignScript Libraries
import sys
import clr
clr.AddReference('ProtoGeometry')
from Autodesk.DesignScript.Geometry import *

################Module For Functional Programing##########################
from functools import reduce
from itertools import chain
from itertools import groupby
from copy import deepcopy
curry = lambda f: lambda a,*args: f(a, *args) if (len(args)) else lambda *args: f(a, *args)

filter = curry(filter)
map = curry(map)
reduce = curry(reduce)

go = lambda *args: reduce(lambda a,f: f(a), args) ## 함수도 축약 가능 ##

def dictUpdate(dic1,dic2):
    res = dic1.update(dic2)
    #res = {**dic1,**dic2}
    return dic1 #res
    
def dictsMerge(dics):
    res = reduce(dictUpdate, dics)
    return res
    
def dictDeleteKeys(dic, keys):
    for k in keys:
        del dic[k]
    return dic
##########################################################################

# The inputs to this node will be stored as a list in the IN variables.
dataEnteringNode = IN
elemDicts = IN[0]
#test_sample = elemDicts[303]

# Place your code below this line

def tmp_switchEarthworkFormula(elemDict):
    
    for i in elemDict["wms"]["wmSpecs"]:
        calcFormulas = filter(lambda x: "산출식" in x ,list(i.Keys))
        for k in calcFormulas:
            if i[k] in ["=Exca", "=Back", "=Disp"]:
                i[k] = "_tbd"
        
    return elemDict

def tmp_switchEarthworkFormula_allDicts(elemDicts):
    return list(map(tmp_switchEarthworkFormula, elemDicts))

# Assign your output to the OUT variable.
OUT = tmp_switchEarthworkFormula_allDicts(elemDicts)
# ----------------------------------------
토공_계산_1_1_1 = Python(IN[0]=code_block_21, IN[1]=code_block_22, IN[2]=allElemsDict, IN[3]=code_block_26)  # CPython3; frozen
# ---------- 토공_계산_1_1_1.python (525 lines) ----------
# Load the Python Standard and DesignScript Libraries
import sys
import clr
clr.AddReference('ProtoGeometry')
from Autodesk.DesignScript.Geometry import *

import Revit

################Module For Functional Programing##########################
from functools import reduce
from itertools import chain
from itertools import groupby
from copy import deepcopy
curry = lambda f: lambda a,*args: f(a, *args) if (len(args)) else lambda *args: f(a, *args)

filter = curry(filter)
map = curry(map)
reduce = curry(reduce)

go = lambda *args: reduce(lambda a,f: f(a), args) ## 함수도 축약 가능 ##

def dictUpdate(dic1,dic2):
    res = dic1.update(dic2)
    #res = {**dic1,**dic2}
    return dic1 #res
    
def dictsMerge(dics):
    res = reduce(dictUpdate, dics)
    return res
    
def dictDeleteKeys(dic, keys):
    for k in keys:
        del dic[k]
    return dic
##########################################################################

# The inputs to this node will be stored as a list in the IN variables.
dataEnteringNode = IN
calcMode = IN[0]
excaMode = IN[1]
elemDicts = IN[2]
earth_CommonInfoDict = IN[3]
#test_sample = elemDicts[303]

# Place your code below this line
LD = earth_CommonInfoDict["LD"]
GL = Revit.Elements.Coordinates.BasePoint().Z - LD * 1000

GWL = earth_CommonInfoDict["GWL"] * 1000
GWLplane = Plane.ByOriginNormal(Point.ByCoordinates(0,0,GWL), Vector.ByCoordinates(0,0,1))

def find_belowSrf_simple(elem):
    res = go(
        elem.Geometry(),
        map(BoundingBox.ByGeometry), map(BoundingBox.ToCuboid),
        map(lambda x: x.Explode()),
        lambda x: list(chain(*x)),
        filter(lambda x: x.NormalAtParameter(0.5,0.5).Z < -0.1),list,
    )
    if res:
        return res

def find_belowSrf_complex(elem):
    res = go(
        elem.Geometry(),
        #map(BoundingBox.ByGeometry), map(BoundingBox.ToCuboid),
        map(lambda x: x.Explode()),
        lambda x: list(chain(*x)),
        filter(lambda x: x.NormalAtParameter(0.5,0.5).Z < -0.1),list,
    )
    if res:
        return res
        
def find_aboveSrf_simple(elem):
    res = go(
        elem.Geometry(),
        map(BoundingBox.ByGeometry), map(BoundingBox.ToCuboid),
        map(lambda x: x.Explode()),
        lambda x: list(chain(*x)),
        filter(lambda x: x.NormalAtParameter(0.5,0.5).Z == 1),list,
    )
    if res:
        return res
        
def add_defaultEarthInfo(elemDict, GWL, GL):
    elem = elemDict["Elem"]
    if "_ExcaTgt" in elemDict["wms"]["Family Type Name"]:
        btmSrfs = find_belowSrf_complex(elem)
        btmSrfs = btmSrfs if btmSrfs else []
    else:
        btmSrfs = find_belowSrf_simple(elem)
        btmSrfs = btmSrfs if btmSrfs else []
    uprSrfs = find_aboveSrf_simple(elem)
    uprSrfs = uprSrfs if uprSrfs else []
    
    btmZ = min( list(map(lambda x: x.PointAtParameter(0.5,0.5).Z, btmSrfs))\
                        if btmSrfs else [0] )
    uprZ = max( list(map(lambda x: x.PointAtParameter(0.5,0.5).Z, uprSrfs))\
                        if uprSrfs else [0] )
    
    btmArea = sum(list(map(lambda x: x.Area, btmSrfs)))
    elem_Volume = btmArea * abs(uprZ - btmZ)
    Btm_toGWL_volume = btmArea * ( GWL - btmZ ) / 1000000000
    GWL_toGL_volume = btmArea * ( GL - GWL ) / 1000000000
    Btm_toGL_volume = btmArea * ( GL - btmZ ) / 1000000000
    
    res = {
        "isExca": False,
        "btmSrfs": btmSrfs,
        "uprSrfs": uprSrfs,
        "btmArea": btmArea,
        "btmZ": btmZ,
        "uprZ": uprZ,
        "elem_Volume": elem_Volume,
        "Btm_toGWL_volume": Btm_toGWL_volume\
                            if Btm_toGWL_volume > 0 else 0 ,
        "GWL_toGL_volume": GWL_toGL_volume\
                            if GWL_toGL_volume > 0 else 0 ,
        "Btm_toGL_volume": Btm_toGL_volume\
                            if Btm_toGL_volume > 0 else 0 ,
    }
    
    
    elemDict["earthInfo"] = res
    return elemDict

def filter_EarthworkCalcTarget(elemDicts, GWL, GL):
    ruleCondition = lambda x:\
        "H1_" in x["wms"]["Family Type Name"] or\
        "S18_W" in x["wms"]["Family Type Name"] or\
        "S18_MAT" in x["wms"]["Family Type Name"] or\
        "S18_Wall" in x["wms"]["Family Type Name"] or\
        "B01" in x["wms"]["Family Type Name"] or\
        "B08_UG RC Slab" in x["wms"]["Family Type Name"] or\
        "B08_Ext Wall_RC_UG_Pit" in x["wms"]["Family Type Name"] or\
        "S16_UG" in x["wms"]["Family Type Name"] or\
        "S16_TG" in x["wms"]["Family Type Name"] or\
        "S17_SOG" in x["wms"]["Family Type Name"] or\
        "S17_EQ-Pad" in x["wms"]["Family Type Name"] or\
        "S17_Edge" in x["wms"]["Family Type Name"] or\
        "S17_Suspend" in x["wms"]["Family Type Name"] or\
        "S15_UG" in x["wms"]["Family Type Name"] or\
        "B08_Stoop" in x["wms"]["Family Type Name"] or\
        "B08_Ramp" in x["wms"]["Family Type Name"] or\
        "_ExcaTgt" in x["wms"]["Family Type Name"]
    res = go(
        elemDicts,
        filter(lambda x: ruleCondition(x)),
        map( lambda x: add_defaultEarthInfo(x, GWL, GL) ),
        list,
    )
    remain = go(
        elemDicts,
        filter(lambda x: not ruleCondition(x)),
        list,
    )
    return res, remain


def filter_ExcaTarget(earthworkCalcTargets):
    res = go(
        earthworkCalcTargets,
        filter(lambda x:
            "B08_Ext Wall" not in x["wms"]["Family Type Name"] and
            "S15_UG" not in x["wms"]["Family Type Name"]
        ),
        list,
    )
    for x in res:
        x["earthInfo"]["isExca"] = True
    return res


def find_eachExcaShape(elemDict, GWL, GL, LD):
    belowSrfs = elemDict["earthInfo"]["btmSrfs"]
    btm_GL_Z = elemDict["earthInfo"]["btmZ"]
    G = elemDict["wms"]["Post_Sym_Val Dict"]["G"]
    GL_FL_gap = LD
    leanThk = elemDict["wms"]["Post_Sym_Val Dict"]["C1"] * 1000
    baseThk = elemDict["wms"]["Post_Sym_Val Dict"]["C2"] * 1000
    subBaseThk = elemDict["wms"]["Post_Sym_Val Dict"]["C3"] * 1000
    extraThk = elemDict["wms"]["Post_Sym_Val Dict"]["C4"] * 1000
    base_downHeight = leanThk + baseThk + subBaseThk + extraThk
    excaHeight = -btm_GL_Z + base_downHeight
    leanOffset = elemDict["wms"]["Post_Sym_Val Dict"]["D1"] * 1000
    excaOffset = elemDict["wms"]["Post_Sym_Val Dict"]["D2"] * 1000
    belowOffset = leanOffset + excaOffset
    upperOffset = G * excaHeight
    
    find_belowRef = lambda belowSrf: go(
        belowSrf,
        lambda x: x.Translate(0, 0, -base_downHeight),
        lambda x: x.PerimeterCurves(),
        PolyCurve.ByJoinedCurves,
        lambda x: x.OffsetMany(-belowOffset, False, Vector.ZAxis()),
        lambda x: x[0],
        Surface.ByPatch,
        BoundingBox.ByGeometry,
        lambda x: [x.MinPoint, x.MaxPoint],
        lambda x: Cuboid.ByCorners(*x),
        lambda x: x.Explode()[0],
        lambda x: x.PerimeterCurves(),
        PolyCurve.ByJoinedCurves,
    )
    
    find_upperRef = lambda belowSrf: go(
        belowSrf,
        lambda x: x.Translate(0, 0, -btm_GL_Z),
        lambda x: x.PerimeterCurves(),
        PolyCurve.ByJoinedCurves,
        lambda x: x.OffsetMany(-upperOffset, False, Vector.ZAxis()),
        lambda x: x[0],
        Surface.ByPatch,
        BoundingBox.ByGeometry,
        lambda x: [x.MinPoint, x.MaxPoint],
        lambda x: Cuboid.ByCorners(*x),
        lambda x: x.Explode()[0],
        lambda x: x.PerimeterCurves(),
        PolyCurve.ByJoinedCurves,
    )
    
    belowRefs = list(map(find_belowRef, belowSrfs))
    upperRefs = list(map(find_upperRef, belowSrfs))
    exca_RefGroups = list(zip(belowRefs,upperRefs))
    exca_Shape = Solid.ByUnion( map(Solid.ByLoft, exca_RefGroups) )
    
    return exca_Shape

def find_unionExcaShape(excaTargets, GWL, GL, LD):
    excaSolids = []
    for elemDict in excaTargets:
        try:
            excaSolids.append( find_eachExcaShape(elemDict, GWL, GL, LD) )
            res = Solid.ByUnion(excaSolids)
        except:
            res = Cuboid.ByLengths(1,1,1)
    return res
    
def find_unionExcaShape_whole(excaTargets, GWL, GL, LD, earth_CommonInfoDict):
    #belowSrfs = elemDict["earthInfo"]["btmSrfs"]
    #btm_GL_Z = elemDict["earthInfo"]["btmZ"]
    
    allElems = list(map(lambda x: x["Elem"], excaTargets))
    def makeBdCube(e):
        eGeo = e.Geometry()[0]
        eBdBoxCube = BoundingBox.ByGeometry(eGeo).ToCuboid()
        return eBdBoxCube
    
    def find_elemsGeo(allElems):
        #flatten_Elems = list(chain(*excaTargets))
        allGeo = []
        for e in allElems:
            try:
                allGeo.append(makeBdCube(e))
            except:
                pass
        return allGeo
        
    def findWholeBdBox(allElems):
        allGeo = find_elemsGeo(allElems)
        unionBdCube = BoundingBox.ByGeometry(allGeo).ToCuboid()
        return unionBdCube
    
    find_belowRef = lambda belowSrf: go(
        belowSrf,
        lambda x: x.Translate(0, 0, -base_downHeight),
        lambda x: x.PerimeterCurves(),
        PolyCurve.ByJoinedCurves,
        lambda x: x.OffsetMany(-belowOffset, False, Vector.ZAxis()),
        lambda x: x[0],
        Surface.ByPatch,
        BoundingBox.ByGeometry,
        lambda x: [x.MinPoint, x.MaxPoint],
        lambda x: Cuboid.ByCorners(*x),
        lambda x: x.Explode()[0],
        lambda x: x.PerimeterCurves(),
        PolyCurve.ByJoinedCurves,
    )
    
    find_upperRef = lambda belowSrf: go(
        belowSrf,
        lambda x: x.Translate(0, 0, -btm_GL_Z),
        lambda x: x.PerimeterCurves(),
        PolyCurve.ByJoinedCurves,
        lambda x: x.OffsetMany(-upperOffset, False, Vector.ZAxis()),
        lambda x: x[0],
        Surface.ByPatch,
        BoundingBox.ByGeometry,
        lambda x: [x.MinPoint, x.MaxPoint],
        lambda x: Cuboid.ByCorners(*x),
        lambda x: x.Explode()[0],
        lambda x: x.PerimeterCurves(),
        PolyCurve.ByJoinedCurves,
    )

    unionBdCube = findWholeBdBox(allElems)
    belowSrfs = go(
        [unionBdCube],
        map(BoundingBox.ByGeometry), map(BoundingBox.ToCuboid),
        map(lambda x: x.Explode()),
        lambda x: list(chain(*x)),
        filter(lambda x: x.NormalAtParameter(0.5,0.5).Z < -0.1),list,
    )
    
    btm_GL_Z = min( list(map(lambda x: x.PointAtParameter(0.5,0.5).Z, belowSrfs))\
                        if belowSrfs else [0] )

    G = earth_CommonInfoDict["G"]
    GL_FL_gap = LD
    leanThk = earth_CommonInfoDict["C1"] * 1000
    baseThk = earth_CommonInfoDict["C2"] * 1000
    subBaseThk = earth_CommonInfoDict["C3"] * 1000
    extraThk = earth_CommonInfoDict["C4"] * 1000
    base_downHeight = leanThk + baseThk + subBaseThk + extraThk
    excaHeight = -btm_GL_Z + base_downHeight
    leanOffset = earth_CommonInfoDict["D1"] * 1000
    excaOffset = earth_CommonInfoDict["D2"] * 1000
    belowOffset = leanOffset + excaOffset
    upperOffset = G * excaHeight

    belowRefs = list(map(find_belowRef, belowSrfs))
    upperRefs = list(map(find_upperRef, belowSrfs))
    exca_RefGroups = list(zip(belowRefs,upperRefs))
    exca_Shape = Solid.ByUnion( map(Solid.ByLoft, exca_RefGroups) )
    
    return exca_Shape
    
def find_disposalShape(elemDict):
    elemDisposal_shape = Solid.ByUnion(list(elemDict["Elem"].Geometry()))
    
    leanThk = elemDict["wms"]["Post_Sym_Val Dict"]["C1"] * 1000
    baseThk = elemDict["wms"]["Post_Sym_Val Dict"]["C2"] * 1000
    subBaseThk = elemDict["wms"]["Post_Sym_Val Dict"]["C3"] * 1000
    extraThk = elemDict["wms"]["Post_Sym_Val Dict"]["C4"] * 1000
    base_downHeight = leanThk + baseThk + subBaseThk + extraThk
    
    belowSrfs = elemDict["earthInfo"]["btmSrfs"]
    offset = elemDict["wms"]["Post_Sym_Val Dict"]["D1"]*1000\
                + (elemDict["wms"]["Post_Sym_Val Dict"]["D2"]/2) *1000
    
    find_nonElemDisposal_belowRefs = lambda belowSrf: go(
        belowSrf,
        lambda x: x.Translate(0, 0, -base_downHeight),
        lambda x: x.PerimeterCurves(),
        PolyCurve.ByJoinedCurves,
        lambda x: x.OffsetMany(-offset, False, Vector.ZAxis()),
        lambda x: x[0],
        Surface.ByPatch,
        BoundingBox.ByGeometry,
        lambda x: [x.MinPoint, x.MaxPoint],
        lambda x: Cuboid.ByCorners(*x),
        lambda x: x.Explode()[0],
        lambda x: x.PerimeterCurves(),
        PolyCurve.ByJoinedCurves,
    )
    find_nonElemDisposal_upperRefs = lambda belowSrf: go(
        belowSrf,
        lambda x: x.PerimeterCurves(),
        PolyCurve.ByJoinedCurves,
        lambda x: x.OffsetMany(-offset, False, Vector.ZAxis()),
        lambda x: x[0],
        Surface.ByPatch,
        BoundingBox.ByGeometry,
        lambda x: [x.MinPoint, x.MaxPoint],
        lambda x: Cuboid.ByCorners(*x),
        lambda x: x.Explode()[0],
        lambda x: x.PerimeterCurves(),
        PolyCurve.ByJoinedCurves,
    )

    nonElemDisposal_belowRefs = list(map(find_nonElemDisposal_belowRefs, belowSrfs))
    nonElemDisposal_upperRefs = list(map(find_nonElemDisposal_upperRefs, belowSrfs))
    nonElemDisposal_RefGroups = list(zip(nonElemDisposal_belowRefs,nonElemDisposal_upperRefs))
    nonElemDisposal_Shape = Solid.ByUnion( map(Solid.ByLoft, nonElemDisposal_RefGroups) )
    disposal_shape = Solid.ByUnion( [elemDisposal_shape, nonElemDisposal_Shape] )
    
    return disposal_shape

def find_unionDisposalShape(earthCalcTargets):
    disposal_Solids = []
    for elemDict in earthCalcTargets:
        try:
            disposal_Solids.append( find_disposalShape(elemDict) )
        except:
            pass
    return Solid.ByUnion(disposal_Solids)
    
def add_dispoAndbackfill_qty_toElemDicts(earthCalcTargets, unionDisposalShape, unionBackfillShape):
    whole_disposalShape_volume = unionDisposalShape.Volume
    whole_backfillShape_volume = unionBackfillShape.Volume
    target = earthCalcTargets
    
    total_toGLvolume = go(
        target,
        map(lambda x: x["earthInfo"]["Btm_toGL_volume"]),
        sum,
    )
    
    def find_asignedQty_elemDict(d, wholeVolume):
        res = go(
            d,
            lambda x: (x["earthInfo"]["Btm_toGL_volume"] / total_toGLvolume) * wholeVolume,
            lambda x: x / 1000000000,
        )
        return res
     
    res = go(
        target,
        map( lambda x: 
            dict( x, **{"earthQty": {
                                        "disposal": find_asignedQty_elemDict(x, whole_disposalShape_volume),
                                        "backfill": find_asignedQty_elemDict(x, whole_backfillShape_volume),
                                    }} ) 
        ),
        list,
    )
    return res
    
def add_above_excavation_qty_toElemDicts(elemDicts, above_GWL_excaShape, below_GWL_excaShape):
    cond_inter_GWL = lambda x: x["earthInfo"]["Btm_toGWL_volume"] != 0 and \
                    x["earthInfo"]["Btm_toGWL_volume"] < x["earthInfo"]["elem_Volume"]
    cond_above_GWL = lambda x: x["earthInfo"]["Btm_toGWL_volume"] == 0
    cond_below_GWL = lambda x: x["earthInfo"]["Btm_toGWL_volume"] != 0 and \
                    x["earthInfo"]["Btm_toGWL_volume"] >= x["earthInfo"]["elem_Volume"]
    
    total_Btm_toGL_volume  = go(
        elemDicts,
        filter(lambda elemDict: elemDict["earthInfo"]["isExca"]),
        filter( lambda elemDict: cond_above_GWL(elemDict) ),
        map(lambda elemDict: elemDict["earthInfo"]["Btm_toGL_volume"]),
        sum,
    )
    total_GWL_toGL_volume  = go(
        elemDicts,
        filter(lambda elemDict: elemDict["earthInfo"]["isExca"]),
        filter( lambda elemDict: cond_inter_GWL(elemDict) or cond_below_GWL(elemDict) ),
        map(lambda elemDict: elemDict["earthInfo"]["GWL_toGL_volume"]),
        sum,
    )
    total_ref_volume = total_Btm_toGL_volume + total_GWL_toGL_volume
    exca_above_total_volume = above_GWL_excaShape.Volume
    exca_below_total_volume = below_GWL_excaShape.Volume
    
    def find_asignedQty_elemDict(elemDict):
        if elemDict["earthInfo"]["isExca"] and cond_inter_GWL(elemDict):
            elemDict["earthQty"]["exca_above"] = ( exca_above_total_volume * (elemDict["earthInfo"]["GWL_toGL_volume"] / total_ref_volume) ) / 1000000000
        elif elemDict["earthInfo"]["isExca"] and cond_above_GWL(elemDict):
            elemDict["earthQty"]["exca_above"] = ( exca_above_total_volume * (elemDict["earthInfo"]["Btm_toGL_volume"] / total_ref_volume) ) / 1000000000
        else:
            elemDict["earthQty"]["exca_above"] = 0.0
        return elemDict
    res = list(map( lambda x: find_asignedQty_elemDict(x), elemDicts ))
    return res

def add_below_excavation_qty_toElemDicts(elemDicts, above_GWL_excaShape, below_GWL_excaShape):
    cond_belowOrInter_GWL = lambda x: x["earthInfo"]["Btm_toGWL_volume"] != 0
    
    total_Btm_toGWL_volume  = go(
        elemDicts,
        filter(lambda elemDict: elemDict["earthInfo"]["isExca"]),
        filter( lambda elemDict: cond_belowOrInter_GWL(elemDict) ),
        map(lambda elemDict: elemDict["earthInfo"]["Btm_toGWL_volume"]),
        sum,
    )
    total_ref_volume = total_Btm_toGWL_volume
    exca_above_total_volume = above_GWL_excaShape.Volume
    exca_below_total_volume = below_GWL_excaShape.Volume
    
    def find_asignedQty_elemDict(elemDict):
        if elemDict["earthInfo"]["isExca"] and cond_belowOrInter_GWL(elemDict):
            elemDict["earthQty"]["exca_below"] = exca_below_total_volume/1000000000 * (elemDict["earthInfo"]["Btm_toGWL_volume"] / total_ref_volume)
        else:
            elemDict["earthQty"]["exca_below"] = 0.0
        return elemDict
    res = list(map( lambda x: find_asignedQty_elemDict(x), elemDicts ))
    return res


earthCalcTargets, remainElemDicts = filter_EarthworkCalcTarget(elemDicts, GWL, GL)
excaTargets = filter_ExcaTarget(earthCalcTargets)

if excaMode == "개별터파기":
    unionExcaShape = find_unionExcaShape(excaTargets, GWL, GL, LD)
    unionPreDisposalShape = find_unionDisposalShape(earthCalcTargets)
    unionBackfillShape = unionExcaShape.Split(unionPreDisposalShape)[0]
    unionBackfillShape_volume = unionBackfillShape.Volume
    try:
        unionDisposalShape = unionExcaShape.Split(unionPreDisposalShape)[1]
        unionDisposalShape_volume = unionDisposalShape.Volume
        above_GWL_excaShape, below_GWL_excaShape = unionExcaShape.Split(GWLplane)
    except:
        unionDisposalShape_volume = 0
        above_GWL_excaShape, below_GWL_excaShape = None,None
    
    earthCalcTargets_dispoAndbackfill = add_dispoAndbackfill_qty_toElemDicts(earthCalcTargets, unionDisposalShape, unionBackfillShape)
    
    earthCalcTargets_aboveExca = add_above_excavation_qty_toElemDicts(earthCalcTargets_dispoAndbackfill, above_GWL_excaShape, below_GWL_excaShape)
    earthCalcTargets_calcFinshed = add_below_excavation_qty_toElemDicts(earthCalcTargets_aboveExca, above_GWL_excaShape, below_GWL_excaShape)
    
    OUT = earthCalcTargets_calcFinshed + remainElemDicts
    
elif excaMode == "온통터파기":
    unionExcaShape = find_unionExcaShape_whole(excaTargets, GWL, GL, LD, earth_CommonInfoDict)
    unionPreDisposalShape = find_unionDisposalShape(earthCalcTargets)
    unionBackfillShape = unionExcaShape.Split(unionPreDisposalShape)[0]
    unionBackfillShape_volume = unionBackfillShape.Volume
    unionDisposalShape = unionExcaShape.Split(unionPreDisposalShape)[1]
    unionDisposalShape_volume = unionDisposalShape.Volume
    above_GWL_excaShape, below_GWL_excaShape = unionExcaShape.Split(GWLplane)
    
    earthCalcTargets_dispoAndbackfill = add_dispoAndbackfill_qty_toElemDicts(earthCalcTargets, unionDisposalShape, unionBackfillShape)
    
    earthCalcTargets_aboveExca = add_above_excavation_qty_toElemDicts(earthCalcTargets_dispoAndbackfill, above_GWL_excaShape, below_GWL_excaShape)
    earthCalcTargets_calcFinshed = add_below_excavation_qty_toElemDicts(earthCalcTargets_aboveExca, above_GWL_excaShape, below_GWL_excaShape)
    
    OUT = earthCalcTargets_calcFinshed + remainElemDicts

# Assign your output to the OUT variable.
#OUT = earthCalcTargets
#OUT = unionExcaShape.Volume/1000000000
#OUT = above_GWL_excaShape.Volume/1000000000, below_GWL_excaShape.Volume/1000000000
#OUT = above_GWL_excaShape, below_GWL_excaShape
#OUT = unionDisposalShape_volume/1000000000, unionBackfillShape_volume/1000000000
#OUT = earthCalcTargets_calcFinshed, []
#OUT = earthCalcTargets_calcFinshed + remainElemDicts
# ----------------------------------------

code_block_28 = CodeBlock(finRes=부재_wm_별_산식에_의한_최종_계산) { finRes; }

# group: 시트별 시작:끝행 추출
count = List.Count(list=code_block_18@L3)
code_block_29 = CodeBlock { -14; }
takeItems = List.TakeItems(list=count, amount=code_block_29)
code_block_30 = CodeBlock { 2; }
range = Range(start=code_block_30, end=count)

sheet_rowRange = CodeBlock(i=count) { i; }
sheet_rowRange_2 = CodeBlock(i=sheet_rowRange) { i; }
sheet_rowRange_3 = CodeBlock(i=sheet_rowRange_2) { i; }

# group: Family List 타입별 물량 기입을 위한 데이터 포맷팅 구간
code_block_31 = CodeBlock()
# ---------- code_block_31.designscript (15 lines) ----------
["0.Room"
,"1.Floors"
,"2.Roofs"
,"3.Walls_Ext"
,"3.Walls_Int"
,"4.St_Fdn"
,"5.St_Col"
,"6.St_Framing"
,"7.Ceilings"
,"8.Doors"
,"9.Windows"
,"10.Stairs"
,"11.Railings"
,"12.Generic"
,"13.Manual_Input"];
# ----------------------------------------
code_block_32 = CodeBlock(res=code_block_28) { res; }
code_block_33 = CodeBlock(i=code_block_32) { i["wms"]["wmSpecs"]; }
flatten_2 = List.Flatten(list=code_block_33)
code_block_34 = CodeBlock(i=flatten_2) { i["Family Category"]; }
groupByKey = List.GroupByKey(list=flatten_2, keys=code_block_34)
code_block_35 = CodeBlock(usedSheetNames=groupByKey.uniqueKeys) { usedSheetNames; }
indexOf = List.IndexOf(list=code_block_31, element=code_block_35)
code_block_36 = CodeBlock(i=groupByKey.groups) { i["rIDX"]; }
groupByKey_2 = List.GroupByKey(list=groupByKey.groups@L2, keys=code_block_36@L2)
code_block_37 = CodeBlock(i=groupByKey_2.groups) { i["rIDX"]; }
# note: WM 별로 합산 구간 추가 필요
uniqueItems_3 = List.UniqueItems(list=code_block_37@@L2)
code_block_38 = CodeBlock { 1; }
flatten_3 = List.Flatten(list=uniqueItems_3@@L3, amount=code_block_38)
code_block_39 = CodeBlock(i=groupByKey_2.groups) { i["Quantity"]; }
sum_without_err = Python(IN[0]=code_block_39)  # CPython3
# ---------- sum_without_err.python (23 lines) ----------
# Load the Python Standard and DesignScript Libraries
import sys
import clr
clr.AddReference('ProtoGeometry')
from Autodesk.DesignScript.Geometry import *

# The inputs to this node will be stored as a list in the IN variables.
dataEnteringNode = IN
cat_rIDX_vals = IN[0]
# Place your code below this line

res = []
for catGrp in cat_rIDX_vals:
    new_catGrp = []
    for i in catGrp:
        try:
            new_catGrp.append(sum(i))
        except:
            new_catGrp.append(0)
    res.append(new_catGrp)

# Assign your output to the OUT variable.
OUT = res
# ----------------------------------------
code_block_40 = CodeBlock { ""; }
sheet_rowRange_4 = CodeBlock(i=sheet_rowRange_3) { i; }
cycle = List.Cycle(list=code_block_40, amount=sheet_rowRange_4)
replace_forCalcultionExport = Python(IN[0]=indexOf, IN[1]=flatten_3, IN[2]=sum_without_err, IN[3]=cycle)  # CPython3
# ---------- replace_forCalcultionExport.python (34 lines) ----------
# Load the Python Standard and DesignScript Libraries
import sys
import clr
clr.AddReference('ProtoGeometry')
from Autodesk.DesignScript.Geometry import *

# The inputs to this node will be stored as a list in the IN variables.
dataEnteringNode = IN
replaceSheetIdx = IN[0]
replace_idxsGrps = IN[1]
replace_valsGrps = IN[2]
src_list = IN[3]


# Place your code below this line
def replace_calcForExport(replace_idxsGrps, replace_valsGrps, src_list, replaceSheetIdx):
    zipped_cats = list(zip(replace_idxsGrps, replace_valsGrps))
    for x in range(len(zipped_cats)):
        grps_cat = zipped_cats[x]
        src_cat = src_list[replaceSheetIdx[x]]
        for i in range(len(grps_cat[0])):
            idx = grps_cat[0][i]
            print(idx)
            vals = grps_cat[1][i]
            src_cat[idx] = vals
    return src_list
        
if any(replaceSheetIdx):
    res = replace_calcForExport(replace_idxsGrps, replace_valsGrps, src_list, replaceSheetIdx)
else:
    res = src_list

# Assign your output to the OUT variable.
OUT = res
# ----------------------------------------
code_block_41 = CodeBlock { 2; }
dropItems = List.DropItems(list=replace_forCalcultionExport@L2, amount=code_block_41)
getItemAtIndex_2 = List.GetItemAtIndex(list=cycle, index=indexOf)

# group: Family List 타입별 물량 기입 구간
code_block_42 = CodeBlock(file_path=code_block_17) { file_path; }
allSheetNames = CodeBlock(allSheetNames=code_block_31) { allSheetNames; }
code_block_43 = CodeBlock { 2; }
code_block_44 = CodeBlock(data=dropItems) { data; }
exportToExcel = Data.ExportToExcel(filePath=code_block_42, sheetName=allSheetNames@L1, startRow=code_block_43, startColumn=시트별_quantity_열_인덱스_4@L1, data=code_block_44@L2)

n4_total_boq_sheet_경로_입력 = Filename("..\etc\물량산출테스트용\debug\20240902_khh\Total BOQ_blank.xlsx")  # "4. Total BOQ sheet 경로 입력"; graph input
code_block_45 = CodeBlock(totalBOQpath=n4_total_boq_sheet_경로_입력) { totalBOQpath; }
code_block_46 = CodeBlock(totalBOQpath=code_block_45) { totalBOQpath; }
firstItem = List.FirstItem(list=code_block)
code_block_47 = CodeBlock(wm_sheetDatas=firstItem) { wm_sheetDatas; }
code_block_48 = CodeBlock(wm_sheetDatas=code_block_47) { wm_sheetDatas; }

# group: [WM-AR] 시트 데이터 정리
code_block_49 = CodeBlock(wm_sheetDatas=code_block_48) { wm_sheetDatas; }
code_block_50 = CodeBlock { 3+8; }
getItemAtIndex_3 = List.GetItemAtIndex(list=code_block_49@L2, index=code_block_50)
code_block_51 = CodeBlock { 6; }
dropItems_2 = List.DropItems(list=getItemAtIndex_3, amount=code_block_51)
uniqueItems_4 = List.UniqueItems(list=dropItems_2)
code_block_52 = CodeBlock(description판별항목1=uniqueItems_4) { description판별항목1; }
code_block_53 = CodeBlock { 5+8; }
getItemAtIndex_4 = List.GetItemAtIndex(list=code_block_49@L2, index=code_block_53)
code_block_54 = CodeBlock { 6; }
dropItems_3 = List.DropItems(list=getItemAtIndex_4, amount=code_block_54)
uniqueItems_5 = List.UniqueItems(list=dropItems_3)
code_block_55 = CodeBlock(description판별항목2=uniqueItems_5) { description판별항목2; }

code_block_56 = CodeBlock(dictPerElem=code_block_28) { dictPerElem; }
code_block_57 = CodeBlock(typeDict=allTypes) { typeDict; }
code_block_58 = CodeBlock(typeDict=code_block_57) { typeDict; }
code_block_59 = CodeBlock()
# ---------- code_block_59.designscript (9 lines) ----------
wmspec_headers = [
    //"Work Master Code" ,"GaugeCode" ,"Unit" ,
    "Work Category-L1"
    ,"Work Category-L2" ,"Work Category-L3" ,"Spec. 1- L4" ,"Spec. 2- L5"
    ,"Spec. 3- L6" ,"Spec. 4- L7" ,"Spec. 5- L8" ,"Spec. 6- L9"
    ,"Spec. 7- L10" ,"Spec. 8- L11" ,"BOQ Spec1" ,"BOQ Spec2" ,"BOQ Spec3"
    ,"BOQ Spec4" ,"BOQ Spec5" ,"BOQ Spec6" ,"BOQ Spec7" ,"BOQ Spec8" ,"BOQ Spec9"
    ,"Work Master Code /w Description", "Description"// ,"입찰_물량산출식" ,"실행_물량산출식" ,"rIDX"
];
# ----------------------------------------
code_block_60 = CodeBlock(wmSpecs_headers=code_block_59) { wmSpecs_headers; }
code_block_61 = CodeBlock(wmSpecs_headers=code_block_60) { wmSpecs_headers; }

# group: Total BOQ 엑셀파일 물량 기입 구간
code_block_62 = CodeBlock(totalBOQpath=code_block_46) { totalBOQpath; }
n5_total_boq_내_시트명_입력 = StringInput("(AR) BOQ View (Working)")  # "5. Total BOQ 내 시트명 입력"; graph input
code_block_63 = CodeBlock(filePath=code_block_62, sheetName=n5_total_boq_내_시트명_입력) { filePath; sheetName; }
n6_건물명_입력 = StringInput("Please enter Building Name before running ")  # "6. 건물명 입력"; graph input
list_create_8 = List.Create(item0=code_block_52, item1=code_block_55)
file_from_path_2 = FileObject(path=code_block_62)
code_block_64 = CodeBlock { "(AR) BOQ"; "(AR) BOQ View (Working)"; false; }
# note: Work Master Code
# Gauge Code
# Description : (L03)
# Spec. : (L04~L11)
# Additional Spec : (Description 항목 값)
importExcel_2 = Data.ImportExcel(file=file_from_path_2, sheetName=n5_total_boq_내_시트명_입력, showExcel=code_block_64.out2)
total_boq_데이터_파싱__ar_boq시트 = Python(IN[0]=n6_건물명_입력, IN[1]=list_create_8, IN[2]=importExcel_2)  # CPython3
# ---------- total_boq_데이터_파싱__ar_boq시트.python (162 lines) ----------
# Load the Python Standard and DesignScript Libraries
import sys
import clr
clr.AddReference('ProtoGeometry')
from Autodesk.DesignScript.Geometry import *

from functools import reduce
from functools import partial
from string import ascii_lowercase
import itertools
from itertools import chain
import re
    
#################################Module For Functional Programing#############################################
curry = lambda f: lambda a,*args: f(a, *args) if (len(args)) else lambda *args: f(a, *args)

filter = curry(filter)
map = curry(map)

def _take(length, iter):
    res = []
    for a in iter:
        res.append(a)
        if len(res) == length:
            return res
        
take = curry(_take)
reduce = curry(reduce)

go = lambda *args: reduce(lambda a,f: f(a), args) ## 함수도 축약 가능 ##
##############################################################################################################
def find_IsInStr(target, str):
    if target == None or str == None:
        pass
    else:
        res = target in str
        return res
        
def find_IsInList(List, str):
    if str == None or List == None:
        pass
    else:
        res = str in List
        return res

def find_range_by_columnItem(db, col_idx, sep_rule):
    tdb = list(map(lambda x: x[col_idx], db))
    last_idx_tdb = len(tdb)-1
    tdb_enum = enumerate(tdb)
    res = list(filter(lambda x: find_IsInStr(sep_rule, x[1]), tdb_enum))
    endidxs_tmp= list(map(lambda x: x[0]-1,res))
    #endidxs_tmp= list(map(lambda x: x[0],res))
    endidxs_tmp.pop(0)
    endidxs = endidxs_tmp + [last_idx_tdb]
    famTypeNames = list(map(lambda x: x[1],res))
    famTypeNamesIdxs = list(map(lambda x: x[0],res))
    rangeSttIdxs = list(map(lambda x: x[0]+1,res))
    rangeEndIdxs = endidxs
    result = dict(zip(famTypeNames, zip(famTypeNamesIdxs, zip(rangeSttIdxs,rangeEndIdxs))))
    return result
    
def find_range_by_columnItem_discrim(db, col_idx, 판별항목):
    tdb = list(map(lambda x: x[col_idx], db))
    last_idx_tdb = len(tdb)-1
    tdb_enum = enumerate(tdb)
    res = list(filter(lambda x: find_IsInList(판별항목, x[1]), tdb_enum))
    endidxs_tmp= list(map(lambda x: x[0]-1,res))
    #endidxs_tmp= list(map(lambda x: x[0],res))
    endidxs_tmp.pop(0)
    endidxs = endidxs_tmp + [last_idx_tdb]
    famTypeNames = list(map(lambda x: x[1],res))
    famTypeNamesIdxs = list(map(lambda x: x[0],res))
    rangeSttIdxs = list(map(lambda x: x[0]+1,res))
    rangeEndIdxs = endidxs
    result = dict(zip(famTypeNames, zip(famTypeNamesIdxs, zip(rangeSttIdxs,rangeEndIdxs))))
    return result

# The inputs to this node will be stored as a list in the IN variables.
dataEnteringNode = IN
bd_name = IN[0]
descr판별항목 = IN[1]
판별항목lv1 = descr판별항목[0]
판별항목lv2 = descr판별항목[1]
db = IN[2]


# Place your code below this line
def Is_newSheet(Sheet):
    
    hdrs_withIdx = dict(list(find_headersAtSheet(Sheet).items()) + list(find_headers_Building(Sheet, bd_name).items()))
    datasOnWMCodeCol = list(map(lambda x: x[hdrs_withIdx["Work Master Code"]], Sheet))
    
    p = re.compile('\w{8}-\w{5}')
    IsNewSheet = not(any(list(map(lambda x: p.match(str(x)), datasOnWMCodeCol))))
    
    
    return [IsNewSheet,datasOnWMCodeCol]
    
def find_headersAtSheet(Sheet):
    headers_Sheet = map(lambda x: [x[1].replace("\n",""),x[0]], filter(lambda x: x[1] != None, enumerate(Sheet[2])))
    res = dict(headers_Sheet)
    #del res["_"]
    
    return res
    
def find_headers_Building(Sheet, bd_name):
    headers_bd = map(lambda x: [x[1].replace("\n",""),x[0]], filter(lambda x: x[1] != None, enumerate(Sheet[3])))
    headers_targetBD = list(filter(lambda x: x[0] == bd_name, headers_bd))
    res = {}
    res["targetBD"] = headers_targetBD[0][1]
    return res

def find_rangesAtSheet(Sheet, hdrs_withIdx, 판별항목):
    return find_range_by_columnItem_discrim(Sheet, hdrs_withIdx["Description"], 판별항목)

def get_DataOnRangesAtSheet(Sheet):
    
    hdrs_withIdx = dict(list(find_headersAtSheet(Sheet).items()) + list(find_headers_Building(Sheet, bd_name).items()))
    rgs_v_lv1 = list(map(lambda x: x[1], find_rangesAtSheet(Sheet, hdrs_withIdx, 판별항목lv1).values()))
    rgs_v_lv2 = list(map(lambda x: x[1], find_rangesAtSheet(Sheet, hdrs_withIdx, 판별항목lv2).values()))
    
    idxs_v_lv1 = list(map(lambda x: range(x[0],x[1]+1), rgs_v_lv1))

    datas_lv1 = []
    col_datas = list(map(lambda x: x[hdrs_withIdx["Description"]], Sheet))
    for rg in idxs_v_lv1:
        lv1_str = col_datas[rg[0]-1]
        tmp = []
        for i in rg:
            tmp.append([i, lv1_str, col_datas[i]])
        
        datas_lv1.append(tmp)

    datas_lv2 = []
    for rg in datas_lv1:
        tmp = []
        for idx,v in enumerate(rg):
            if v[2] == None:
                tmp.append([v[0],v[1],tmp[idx-1][2]])
            else:
                tmp.append(v)
        datas_lv2.append(tmp)

    flatten_res = list(chain(*datas_lv2))
    rres = itertools.groupby(flatten_res, lambda x: [x[1], x[2]])
    
    res = {}
    for k, g in rres:
        #print(list(g))
        removedfirstelem_g = list(g)[1:]
        res["_".join(k)] = [removedfirstelem_g[0][0],removedfirstelem_g[-1][0]]
        #res["_".join(k)] = removedfirstelem_g
    
    return res


hdrs_withIdx = dict(list(find_headersAtSheet(db).items()) + list(find_headers_Building(db, bd_name).items()))

if Is_newSheet(db)[0]:
    OUT = hdrs_withIdx, [Is_newSheet(db)[0],get_DataOnRangesAtSheet(db)]
else:
    OUT = hdrs_withIdx, Is_newSheet(db)
# ----------------------------------------
code_block_65 = CodeBlock(i=total_boq_데이터_파싱__ar_boq시트)
# ---------- code_block_65.designscript (3 lines) ----------
i[0];
i[1];
//구간 rIdx;
# ----------------------------------------
total_boq복사_및_경로_반환 = Python(IN[0]=code_block_63.filePath, IN[1]=code_block_65.out1)  # CPython3
# ---------- total_boq복사_및_경로_반환.python (40 lines) ----------
# Load the Python Standard and DesignScript Libraries
import sys
import clr
clr.AddReference('ProtoGeometry')
from Autodesk.DesignScript.Geometry import *
import datetime
import shutil

# The inputs to this node will be stored as a list in the IN variables.
dataEnteringNode = IN
origin_pathStr = IN[0]
IsNewSheet = IN[1][0]
# Place your code below this line

def copy_fromNewSheet():
    now = datetime.datetime.now()
    #strList = origin_pathStr.split('.')
    strList = origin_pathStr.split('\\')
    path = '\\'.join(strList[:-1])
    fileName = strList[-1]
    fileNameList = fileName.split('.')
    
    add_str = now.strftime("%m%d-%I%M%S")
    add_res = "".join(["_",add_str,"."])
    fileNameList.insert(1, add_res)
    fileName_res = "".join(fileNameList)
    res = path + '\\' + fileName_res
    
    source = origin_pathStr
    destination = res
    shutil.copyfile(source, destination)
    
    return res

# Assign your output to the OUT variable.

if IsNewSheet:
    OUT = copy_fromNewSheet()
else:
    OUT = origin_pathStr
# ----------------------------------------
code_block_66 = CodeBlock(dict_groupBy_Sheet_WM=code_block_56) { dict_groupBy_Sheet_WM; }
wm별_계산결과_및_spec_정리_from_element = Python(IN[0]=code_block_66)  # CPython3
# ---------- wm별_계산결과_및_spec_정리_from_element.python (81 lines) ----------
# Load the Python Standard and DesignScript Libraries
import sys
import clr
clr.AddReference('ProtoGeometry')
from Autodesk.DesignScript.Geometry import *

import operator
from itertools import groupby
import copy

# The inputs to this node will be stored as a list in the IN variables.
dataEnteringNode = IN
elemDicts = IN[0]
# Place your code below this line
specKeys = [
    "Work Category-L1", "Work Category-L2" ,"Work Category-L3",
    "Spec. 1- L4" ,"Spec. 2- L5"
    ,"Spec. 3- L6" ,"Spec. 4- L7" ,"Spec. 5- L8" ,"Spec. 6- L9"
    ,"Spec. 7- L10" ,"Spec. 8- L11" ,"BOQ Spec1" ,"BOQ Spec2" ,"BOQ Spec3"
    ,"BOQ Spec4" ,"BOQ Spec5" ,"BOQ Spec6" ,"BOQ Spec7" ,"BOQ Spec8" ,"BOQ Spec9"
]

def extractCalcResult(elemDicts, specKeys):
    res = []
    for d in elemDicts:
        wms = d["wms"]["wmSpecs"]
        for wm in wms:
            #keys = ["SheetName", "rIDX", "Work Master Code", "Gauge Code", "wmSpecs", "Family Type Name", "calcResult"]
            keys = ["rIDX", "Work Master Code", "GaugeCode", "Quantity"]
            vals = list(map(lambda x: wm[x],keys))
            k_v = list(zip(keys, vals))
            res_d = dict(k_v)
            if "Description" in wm.Keys:
                res_d["Description"] = wm["Description"]
            else:
                res_d["Description"] = ""
            res_d["wmcANDgauge"] = "".join([wm["Work Master Code"],wm["GaugeCode"]])
            res_d["UoM"] = wm["Unit"]
            res_d["wmSpecs"] = list(map(lambda x: wm[x], specKeys))
            res.append(res_d)
        
    return res

def make_dict_groupBy_WM(elemDicts, specKeys):
    extractedDicts = extractCalcResult(elemDicts, specKeys)
    sortedDicts_WMC = sorted(extractedDicts, key=operator.itemgetter("wmcANDgauge"))
    grpDicts_WMC = groupby(sortedDicts_WMC, key=operator.itemgetter("wmcANDgauge"))
    
    res = []
    for k, g in grpDicts_WMC: 
        wmCode = k
        gg = copy.deepcopy(list(g))
        #res.append(gg)
        qtts = map(lambda x: x["Quantity"] if isinstance(x["Quantity"],float) or isinstance(x["Quantity"], int) else 0, gg)
        calcSum = round(sum(qtts),3)
        wmSpecs = gg[0]["wmSpecs"]
        catStr = "_".join([wmSpecs[0],wmSpecs[1]])        
        
        specOnly = list(filter(lambda x: x!=0, wmSpecs))[3:]
        addSpec = gg[0]["Description"]
        dict_res = {
            "catStr": catStr,
            "Work Master Code": wmCode,
            "Gauge Code": gg[0]["GaugeCode"],
            "Description": wmSpecs[2],
            "Spec.": "\n".join(specOnly),
            "Additional Spec.": addSpec,
            "calcVal": calcSum,
            "UoM": gg[0]["UoM"]
            }
        res.append(dict_res)
    
    
    return res

#extDicts = extractCalcResult(elemDicts)


# Assign your output to the OUT variable.
OUT = make_dict_groupBy_WM(elemDicts, specKeys)
#OUT = sorted(set(map(lambda x: x["Work Master Code"], extDicts)))
# ----------------------------------------
code_block_67 = CodeBlock(famTypeDic=code_block_58) { famTypeDic; }
wm별_spec_정리_from_family_list = Python(IN[0]=wm별_계산결과_및_spec_정리_from_element, IN[1]=code_block_67, IN[2]=code_block_61)  # CPython3
# ---------- wm별_spec_정리_from_family_list.python (150 lines) ----------
# Load the Python Standard and DesignScript Libraries
import sys
import clr
clr.AddReference('ProtoGeometry')
from Autodesk.DesignScript.Geometry import *

import operator
from itertools import groupby
from itertools import chain
import copy

# The inputs to this node will be stored as a list in the IN variables.
dataEnteringNode = IN
elemDicts = IN[0]
famTypeDict = IN[1]
wmSpecs_headers = IN[2]
wmDicts = list(famTypeDict.values())
#wmDicts = list(chain(*famTypeDict.values()))
# Place your code below this line
def merge_dicts(*dict_args):
    """
    Given any number of dictionaries, shallow copy and merge into a new dict,
    precedence goes to key-value pairs in latter dictionaries.
    """
    result = {}
    for dictionary in dict_args:
        result.update(dictionary)
    return result

def getUnique_wmDicts(wmDicts):
    headers = wmDicts[0].Keys
    #headers = wmDicts[0].keys()
    wmspec_headers = list(filter(lambda x: "Work C" in x or "Spec" in x, headers))
    noNeedKeys = ["Family Type Name", "Quantity", "rIDX", "Dynamo 물량산출식", "SheetName", "Q'ty Cal Type Tag"]
    def refineDicts(dicts, noNeedKeys):
        dicts_refined = []
        for d in dicts:
            new_d = {}
            keys,vals = d.Keys,d.Values
            keys_new = set(keys) - set(wmspec_headers)
            items = zip(keys, vals)  
            for k,v in items:
                if k not in noNeedKeys+wmspec_headers:
                    new_d[k] = v
                    #new_d["wmSpecs"] = ""
                    new_d["wmSpecs"] = list(map(lambda x: d[x], wmspec_headers))
            dicts_refined.append(new_d)
        return dicts_refined
    #wmDicts_refined = refineDicts(wmDicts, noNeedKeys)
        
    #allWMcodes = list(map(lambda x: x["Work Master Code"], wmDicts_refined))
    allWMcodes = list(map(lambda x: map(lambda y: y["Work Master Code"], x["wmSpecs"]), wmDicts))
    uniqueWMcodes = set(allWMcodes)
    
    def getUnique(dicts, tgt_key):##
        res = []
        tmp = []
        for d in dicts:
            for wm in d["wmSpecs"]:
                if wm[tgt_key] not in tmp:
                    tmp.append(wm[tgt_key])
                    res.append(wm)
        return res
    
    unique_wmDicts = getUnique(wmDicts, "Work Master Code")

        
    return unique_wmDicts
    

    
def reformatDicts(wmDicts, wmSpecs_headers):
    res = []
    
    for wm in wmDicts:
        keys = ["Work Master Code", "GaugeCode"]#, "wmSpecs"]
        vals = list(map(lambda x: wm[x],keys))
        items = list(zip(keys, vals))
        res_d = dict(items)
        
        #res_d["wmSpecs"] = list(map(lambda x: wm[x], wmSpecs_headers[:-2]))
        res_d["wmSpecs"] = list(filter(lambda x: x!=0 or x!="",map(lambda x: wm[x], wmSpecs_headers[:-2])))
        
        if "Description" in wm.Keys:
            res_d["Description"] = wm["Description"]
        else:
            res_d["Description"] = ""
        res_d["wmcANDgauge"] = "".join([str(wm["Work Master Code"]),str(wm["GaugeCode"])])
        res_d["UoM"] = wm["Unit"]
        res.append(res_d)
        
    return res

def make_dict_groupBy_WM(wmDicts, elemDicts):
    unique_wmDicts = getUnique_wmDicts(wmDicts)
    reformated_dicts = reformatDicts(unique_wmDicts, wmSpecs_headers)
    sortedDicts_WMC = sorted(reformated_dicts, key=operator.itemgetter("wmcANDgauge"))
    grpDicts_WMC = groupby(sortedDicts_WMC, key=operator.itemgetter("wmcANDgauge"))
    
    wm_valDicts = {}
    for x in elemDicts:
        wm_valDicts[x["Work Master Code"]] = x["calcVal"]
    
    
    res = []
    for k, g in grpDicts_WMC: 
        wmCode = k
        gg = copy.deepcopy(list(g))
        wmSpecs = gg[0]["wmSpecs"]
        catStr = "_".join([wmSpecs[0],wmSpecs[1]])
        #catStr = gg[0]["catStr"]
        #specOnly = list(filter(lambda x: x!=0 or x!="", wmSpecs))[3:]
        specOnly = list(filter(lambda x: x!=0 and x!="", wmSpecs))[3:]
        addSpec = gg[0]["Description"]
        if wm_valDicts.get(k):
            dict_res = {
                "catStr": catStr,
                "Work Master Code": wmCode,
                "Gauge Code": gg[0]["GaugeCode"],
                "Description": wmSpecs[2],
                "Spec.": "\n".join(specOnly),
                "Additional Spec.": addSpec,
                "calcVal": wm_valDicts[k],
                "UoM": gg[0]["UoM"]
                #"wmSpecs": wmSpecs,
                }
        else:
            dict_res = {
                "catStr": catStr,
                "Work Master Code": wmCode,
                "Gauge Code": gg[0]["GaugeCode"],
                "Description": wmSpecs[2],
                "Spec.": "\n".join(specOnly),
                "Additional Spec.": addSpec,
                "calcVal": "",
                "UoM": gg[0]["UoM"]
                #"wmSpecs": wmSpecs,
                }
        res.append(dict_res)
#        res.append(wmSpecs)
    
    
    return res

#unique_wmDicts = getUnique_wmDicts(wmDicts)
#reformated_dicts = reformatDicts(unique_wmDicts)

# Assign your output to the OUT variable.
#OUT = make_dict_groupBy_WM(wmsList)
OUT = make_dict_groupBy_WM(wmDicts, elemDicts)
# ----------------------------------------
data_formatting_for_excel_export = Python(IN[0]=code_block_65.out1, IN[1]=wm별_spec_정리_from_family_list)  # CPython3
# ---------- data_formatting_for_excel_export.python (80 lines) ----------
# Load the Python Standard and DesignScript Libraries
import sys
import clr
clr.AddReference('ProtoGeometry')
from Autodesk.DesignScript.Geometry import *

from itertools import groupby
from itertools import chain

# The inputs to this node will be stored as a list in the IN variables.
dataEnteringNode = IN

IsNewSheet = IN[0][0]
inputDatas = IN[0][1]
wmsDicts = list(filter(lambda x: x["calcVal"]!="" ,IN[1]))
# Place your code below this line

def get_wmsGrped_sorted_idxed(rangeDicts, wmsDicts):
    wmsSorted = sorted(wmsDicts, key=lambda x: x["Work Master Code"])
    wmsGrped = groupby(wmsDicts, lambda x: x["catStr"])
    wmsGrped_sorted = []
    
    for k,v in wmsGrped:
        grp_sorted = sorted(list(v), key=lambda x: x["Work Master Code"])
        stt_idx = rangeDicts[k][0]
        length_grp = len(grp_sorted)
        idxs = range(stt_idx, stt_idx+length_grp)
        zip_grp_idxs = list(zip(idxs, grp_sorted))
        for i in zip_grp_idxs:
            d = i[1]
            d["rIDX"] = i[0]
        
        wmsGrped_sorted.append(grp_sorted)
        
    wmsGrped_sorted_idxed = list(chain(*wmsGrped_sorted))
    return wmsGrped_sorted_idxed

def get_wmsGrped_sorted_idxed_(rangeDicts, wmsDicts):
    wmsSorted = sorted(wmsDicts, key=lambda x: x["Work Master Code"])
    wmsGrped = groupby(wmsDicts, lambda x: x["catStr"])
    wmsGrped_sorted = []
    
    for k,v in wmsGrped:
        grp_sorted = sorted(list(v), key=lambda x: x["Work Master Code"])
        
        stt_idx = rangeDicts#[k][0]
#        length_grp = len(grp_sorted)
#        idxs = range(stt_idx, stt_idx+length_grp)
#        zip_grp_idxs = list(zip(idxs, grp_sorted))
#        for i in zip_grp_idxs:
#            d = i[1]
#            d["rIDX"] = i[0]
#        
        #wmsGrped_sorted.append(grp_sorted)
        wmsGrped_sorted.append(stt_idx)
#        
    wmsGrped_sorted_idxed = list(chain(*wmsGrped_sorted))
    return wmsGrped_sorted_idxed

def match_DictWithIdx(datasOnWMCodeCol, wmsDicts):
    new_wmsDicts = []
    idxWithDatasOnWMCode = enumerate(datasOnWMCodeCol)
    for d in wmsDicts:
        if d["Work Master Code"] in datasOnWMCodeCol:
            d["rIDX"] = datasOnWMCodeCol.index(d["Work Master Code"])
            new_wmsDicts.append(d)
        else:
            pass
    #res = new_wmsDicts
    return new_wmsDicts

# Assign your output to the OUT variable.
if IsNewSheet:
    rangeDicts = inputDatas
    res = get_wmsGrped_sorted_idxed(rangeDicts, wmsDicts)
else:
    datasOnWMCodeCol = inputDatas
    res = filter(lambda x: x["calcVal"] != "", match_DictWithIdx(datasOnWMCodeCol, wmsDicts))

OUT = res
# ----------------------------------------
export_to_total_boq = Python(IN[0]=total_boq복사_및_경로_반환, IN[1]=code_block_63.sheetName, IN[2]=code_block_65.out0, IN[3]=code_block_65.out1, IN[4]=data_formatting_for_excel_export)  # CPython3; graph output
# ---------- export_to_total_boq.python (111 lines) ----------
# Load the Python Standard and DesignScript Libraries
import sys
import clr
clr.AddReference('ProtoGeometry')
from Autodesk.DesignScript.Geometry import *

from itertools import groupby

import DSOffice

# The inputs to this node will be stored as a list in the IN variables.
dataEnteringNode = IN
filePath = IN[0]
sheetName = IN[1]
hdrs_withIdx = IN[2]
IsNewSheet = IN[3][0]
dictList = IN[4]

# Place your code below this line
exportToExcel = DSOffice.Data.ExportToExcel
#print(hdrs_withIdx)

hdrsColIdxs = [
        hdrs_withIdx["Work Master Code"],
        hdrs_withIdx["Gauge Code"],
        hdrs_withIdx["Description"],
        hdrs_withIdx["Spec."],
        hdrs_withIdx["Additional Spec."],
        hdrs_withIdx["Reference to"],
        hdrs_withIdx["UoM"],
        hdrs_withIdx["targetBD"],
            ]

def writeToNewSheet(dictList):
    dictList_grped = groupby(dictList, lambda x: x["catStr"])
    
    dictList_grpedList = []
    for k,grp in dictList_grped:
        dictList_grpedList.append(list(grp))
    
    def writeExcel(keys, startColhdr, grpedList):
        for i in dictList_grpedList:
            #keys = ["Work Master Code", "Gauge Code", "Description", "Spec.", "Additional Spec.", ]
            startCol = hdrs_withIdx[startColhdr]
            startRow = i[0]["rIDX"]
    
            datas = list(zip(*map(lambda y: map(lambda x: x.get(y), list(i)), keys)))
            #res.append(datas)
            exportToExcel(filePath, sheetName, startRow, startCol, datas)
    
    #keys1 = ["Work Master Code", "Gauge Code", "Description", "Spec.", "Additional Spec.", ]
    keys1 = ["Work Master Code", "Gauge Code", "Description", "Spec.", "Additional Spec.", "Reference to", "UoM"]
    #keys2 = ["UoM"]
    keys3 = ["calcVal"]
    
    writeExcel(keys1,"Work Master Code", dictList_grpedList)
    #writeExcel(keys2,"UoM", dictList_grpedList)
    writeExcel(keys3,"targetBD", dictList_grpedList)
    
    return dictList_grpedList
    
def writeToExistSheet(dictList):
    dictList_grped = groupby(dictList, lambda x: x["catStr"])
    
    dictList_grpedList = []
    for k,grp in dictList_grped:
        dictList_grpedList.append(list(grp))
    
    def writeExcel_(keys,startColhdr, grpedList):
        #res = []
        for i in dictList_grpedList:
            #keys = ["Work Master Code", "Gauge Code", "Description", "Spec.", "Additional Spec.", ]
            startCol = hdrs_withIdx[startColhdr]
            startRow = i[0]["rIDX"]
    
            datas = list(zip(*map(lambda y: map(lambda x: x[y], list(i)), keys)))
            #res.append(datas)
            exportToExcel(filePath, sheetName, startRow, startCol, datas)
        #return res
        
    def writeExcel(key,startColhdr, dictList):
        all_rIDXs = list(map(lambda x: x["rIDX"], dictList))
        min_rIDX = min(all_rIDXs)
        max_rIDX = max(all_rIDXs)
        all_ranges = range(min_rIDX, max_rIDX+1)
        
        startCol = hdrs_withIdx[startColhdr]
        startRow = min_rIDX
        datas = []
        for i in all_ranges:
            if i in all_rIDXs:
                datas.append([dictList[all_rIDXs.index(i)][key]])
            else:
                datas.append([""])
        
        exportToExcel(filePath, sheetName, startRow, startCol, datas)
        
        #return datas
        
    key = "calcVal"
    
        
    writeExcel(key,"targetBD", dictList)
    
    return dictList_grpedList
# Assign your output to the OUT variable.

if IsNewSheet:
    OUT = writeToNewSheet(dictList)
else:
    OUT = writeToExistSheet(dictList)
# ----------------------------------------
code_block_68 = CodeBlock { "Steam Turbine Building"; "Gate House"; }
code_block_69 = CodeBlock(i=code_block_63.filePath) { i; }

# group: Pjt Information Extract
categories_6 = Categories("OST_ProjectInformation")
all_elements_of_category_6 = ElementsOfCategory(Category=categories_6)
firstItem_2 = List.FirstItem(list=all_elements_of_category_6)
code_block_70 = CodeBlock()
# ---------- code_block_70.designscript (4 lines) ----------
[
"Project Name",
"Building Name"
];
# ----------------------------------------
parameterByName = Parameter.ParameterByName(element=firstItem_2, name=code_block_70)
value = Parameter.Value(parameter=parameterByName)
parameters = Element.Parameters(element=firstItem_2)
hasValue = Parameter.HasValue(parameter=parameters)
filterByBoolMask_4 = List.FilterByBoolMask(list=parameters, mask=hasValue)
name = Parameter.Name(parameter=filterByBoolMask_4.in)
code_block_71 = CodeBlock(i=name) { i!="Category"; }
filterByBoolMask_5 = List.FilterByBoolMask(list=filterByBoolMask_4.in, mask=code_block_71)
value_2 = Parameter.Value(parameter=filterByBoolMask_5.in)
code_block_72 = CodeBlock(i=value_2) { i!=""; }
filterByBoolMask_6 = List.FilterByBoolMask(list=filterByBoolMask_5.in, mask=code_block_72)
name_2 = Parameter.Name(parameter=filterByBoolMask_6.in)
value_3 = Parameter.Value(parameter=filterByBoolMask_6.in)
byKeysValues_2 = DesignScript.Builtin.Dictionary.ByKeysValues(keys=name_2, values=value_3)
stringifyJSON = Data.StringifyJSON(values=byKeysValues_2)
list_create_9 = List.Create(item0=name_2, item1=value_3)

building_name = CodeBlock(bdName=value) { bdName; }

# group: HTML 부재별 물량 기입을 위한 데이터 포맷팅 구간
code_block_73 = CodeBlock()
# ---------- code_block_73.designscript (10 lines) ----------
[
"Work Master Code /w Description",
"IfcGUID / GaugeCode",
"Description",
"산출 수식",
"값 대입 수식",
"Quantity",
"Unit",
"rIDX"
];
# ----------------------------------------
code_block_74 = CodeBlock { "GUID"; }
valueAtKey_3 = DesignScript.Builtin.Dictionary.ValueAtKey(dictionary=code_block_28, key=code_block_74)
code_block_75 = CodeBlock(i=code_block_28) { i["wms"]["Family Type Name"]; }
list_create_10 = List.Create()  # unwired: item0
map = List.Map(list=code_block_75, function=list_create_10)
addItemToEnd = List.AddItemToEnd(item=valueAtKey_3@L1, list=map@L2)
code_block_76 = CodeBlock { "Work Master Code"; "Work Master Code /w Description"; "GaugeCode"; }
code_block_77 = CodeBlock(i=code_block_28, a=code_block_76.out1, b=code_block_76.out2)
# ---------- code_block_77.designscript (10 lines) ----------
[
i["wms"]["wmSpecs"][a],
i["wms"]["wmSpecs"][b],
i["wms"]["wmSpecs"]["Description"],
i["wms"]["wmSpecs"]["applyFormula"],
i["wms"]["wmSpecs"]["substFormula"],
i["wms"]["wmSpecs"]["Quantity"],
i["wms"]["wmSpecs"]["Unit"],
i["wms"]["wmSpecs"]["rIDX"]
];
# ----------------------------------------
transpose_2 = List.Transpose(lists=code_block_77@@L4)
transpose_3 = List.Transpose(lists=transpose_2@@L3)
code_block_78 = CodeBlock(i=transpose_3) { i[0]; }
addItemToFront = List.AddItemToFront(item=addItemToEnd@L2, list=code_block_78@@L3, lacing=Shortest)
BOQbyElement_HTML_part = Python(IN[0]=code_block_73, IN[1]=addItemToFront)  # CPython3
# ---------- BOQbyElement_HTML_part.python (100 lines) ----------
# Load the Python Standard and DesignScript Libraries
import sys
import clr
clr.AddReference('ProtoGeometry')
from Autodesk.DesignScript.Geometry import *

clr.AddReference('RevitNodes')
import Revit
clr.ImportExtensions(Revit.Elements)
from Revit import Elements

################Module For Functional Programing#########################
from functools import reduce
from itertools import chain
from itertools import groupby
from copy import deepcopy
curry = lambda f: lambda a,*args: f(a, *args) if (len(args)) else lambda *args: f(a, *args)

filter,map,reduce = curry(filter),curry(map),curry(reduce)

go = lambda *args: reduce(lambda a,f: f(a), args) ## 함수도 축약 가능 ##

def dictUpdate(dic1,dic2):
    dic1.update(dic2)
    return dic1
    
def dictsMerge(dics):
    res = reduce(dictUpdate, dics)
    return res
    
def dictDeleteKeys(dic, keys):
    for k in keys:
        del dic[k]
    return dic

def flat(a):
    if isinstance(a, list):
        for i in a: 
            yield from flat(i)
    else: yield a
      
def grpBy(iter, key):
    f,grpKeys,grps = key,[],[]
    sorted_ = sorted(iter, key=f)
    for key, grp_data in groupby(sorted_,key=f):
        grpKeys.append(key); grps.append(list(grp_data))
    return grps,grpKeys
#########################################################################
# The inputs to this node will be stored as a list in the IN variables.
dataEnteringNode = IN
hdrs = IN[0]
grps = IN[1]
# Place your code below this line
def make_th(row):
    preStr = "<tr>"
    postStr = "</tr>"
    rowStrs = list(map(lambda x: f"<th>{x}</th>", row))
    res = "\n".join([preStr]+rowStrs+[postStr])
    return res

def make_tr(row):
    preStr = "<tr>"
    postStr = "</tr>"
    rowStrs = list(map(lambda x: f"<td>{x}</td>", row))
    res = "\n".join([preStr]+rowStrs+[postStr])
    return res

def make_trs(rows):
    rowsStrs = list(map(make_tr, rows))
    res = "\n".join(rowsStrs)
    return res

def make_trs_hd(rows):
    rowsStrs = list(map(make_th, rows))
    res = "\n".join(rowsStrs)
    return res

def make_wholeTable(rows):
    preStr = "<table>"
    postStr = "</table>"
    trs = make_trs(rows)
    res = "\n".join([preStr, trs, postStr])
    return res

def transTo_tableForm(grp):
    chkbox_tagStr = '<input type="checkbox" id="chkbox" name="checks">'

    #title = "<h5>"+grp.pop(0)+"</h5>"
    title = list(map(lambda x: "<h5>"+x+"</h5>" ,grp.pop(0)))
    #res = [title]
    res = title
    res.append(make_trs(grp))
    
    return res
    
rows = [[make_th(hdrs)]] + list(map(transTo_tableForm, grps))


# Assign your output to the OUT variable.
OUT = make_wholeTable(rows)
# ----------------------------------------
watch = Watch(addItemToFront)  # graph output

# group: HTML 부재별 물량 기입 구간
javascriptPart = Python()  # CPython3; unwired: IN[0], IN[1], IN[2]
# ---------- javascriptPart.python (59 lines) ----------
# Load the Python Standard and DesignScript Libraries
import sys
import clr
clr.AddReference('ProtoGeometry')
from Autodesk.DesignScript.Geometry import *

# The inputs to this node will be stored as a list in the IN variables.
dataEnteringNode = IN

# Place your code below this line
jsPart = '''
function hideAllPages() {
        document.querySelector("#home").style.fontWeight = "normal";
        document.querySelector("#homePage").style.display = "None";
        document.querySelector("#info").style.fontWeight = "normal";
        document.querySelector("#infoPage").style.display = "None";
        document.querySelector("#famType").style.fontWeight = "normal";
        document.querySelector("#famTypePage").style.display = "None";
        document.querySelector("#roomInfo").style.fontWeight = "normal";
        document.querySelector("#roomInfoPage").style.display = "None";
        document.querySelector("#roomInfoPage_chk").style.display = "None";
}

document.querySelector("#cat").onclick = function() {
	    let img = document.createElement("img");
	    img.setAttribute("src", "https://t4.ftcdn.net/jpg/05/62/99/31/360_F_562993122_e7pGkeY8yMfXJcRmclsoIjtOoVDDgIlh.jpg");
	    document.querySelector("#cat").style.display = "None";
	    img.setAttribute("style", "width:300px;margin-top:20px;")
	    document.body.append(img);
	};
document.querySelector("#home").onclick = function() {
        hideAllPages();
        document.querySelector("#home").style.fontWeight = "bolder";
        document.querySelector("#homePage").style.display = "inline";
	};
document.querySelector("#info").onclick = function() {
        hideAllPages();
        document.querySelector("#info").style.fontWeight = "bolder";
        document.querySelector("#infoPage").style.display = "inline";
	};
document.querySelector("#famType").onclick = function() {
        hideAllPages();
        document.querySelector("#famType").style.fontWeight = "bolder";
        document.querySelector("#famTypePage").style.display = "inline";
	};
document.querySelector("#roomInfo").onclick = function() {
        hideAllPages();
        document.querySelector("#roomInfo").style.fontWeight = "bolder";
        document.querySelector("#roomInfoPage").style.display = "inline";
	};
document.querySelector("#roomInfo_chk").onclick = function() {
        hideAllPages();
        document.querySelector("#roomInfo_chk").style.fontWeight = "bolder";
        document.querySelector("#roomInfoPage_chk").style.display = "inline";
	};
	
'''
# Assign your output to the OUT variable.
OUT = jsPart
# ----------------------------------------
cssPart = Python()  # CPython3; unwired: IN[0], IN[1], IN[2]
# ---------- cssPart.python (125 lines) ----------
# Load the Python Standard and DesignScript Libraries
import sys
import clr
clr.AddReference('ProtoGeometry')
from Autodesk.DesignScript.Geometry import *

# The inputs to this node will be stored as a list in the IN variables.
dataEnteringNode = IN

# Place your code below this line
cssPart = '''

/* style.css */
img {
 width : 25%;
 height: 25%; 
}

:root {
  --text-color: #f0f4f5;
  --background-color: #263343;
  --accent-color: orange;
  --icons-color: rgb(152, 187, 201);
  --bodybackground-color: lightgray;
}

th {
  text-align: center;
  padding-left: 30px;
}

td {
  padding-left: 40px;
  border-bottom : 1px solid gray;
  border-collapse : collapse;
}

body {
  margin: 0;
  background-color: var(--bodybackground-color);
  font-family: 'STIX Two Math';
} 

a {
  text-decoration: none;
  color: var(--text-color);
}

.navbar {
  display: flex;
  position: sticky;
  top: 0px; /* 도달했을때 고정시킬 위치 */
  justify-content: space-between;
  align-items: center;
  background-color: var(--background-color);
  padding: 8px 12px;
  font-family: 'STIX Two Math';
}

.navbar__logo i {
  color: var(--accent-color);
  padding-left: 0;
}

.navbar__menu {
  list-style: none;
  display: flex;
  margin: 0;
  padding-left: 0;
}

.navbar__menu li {
  padding: 8px 30px;
  color: var(--text-color);
}

.navbar__menu li:hover {
  background-color: var(--accent-color);
  border-radius: 3px;
}

.navbar__icons {
  list-style: none;
  display: flex;
  color: var(--icons-color);
  margin: 0;
  padding-left: 0;
}

.navbar__icons li {
  padding: 8px 12px;
  margin: 0;
}

#cat {
  display: block;
  }

#home {
  font-weight: bolder;
  }

#homePage {
  display: inline;
  }

#infoPage {
  display: None;
  }

#famTypePage {
  display: None;
  }

#roomInfoPage {
  display: None;
  }

#roomInfoPage_chk {
  display: None;
  }

'''
# Assign your output to the OUT variable.
OUT = cssPart
# ----------------------------------------
navHTML_Part = Python()  # CPython3; unwired: IN[0]
# ---------- navHTML_Part.python (24 lines) ----------
# Load the Python Standard and DesignScript Libraries
import sys
import clr
clr.AddReference('ProtoGeometry')
from Autodesk.DesignScript.Geometry import *

# The inputs to this node will be stored as a list in the IN variables.
dataEnteringNode = IN

# Place your code below this line
navPart = f"""

<nav class="navbar">

  <ul class="navbar__menu">
    <li id="home">Home</li>
  </ul>

</nav>

"""

# Assign your output to the OUT variable.
OUT = navPart
# ----------------------------------------
list_create_11 = List.Create(item0=BOQbyElement_HTML_part)
make_htmlStr = Python(IN[0]=javascriptPart, IN[1]=cssPart, IN[2]=navHTML_Part, IN[3]=building_name, IN[4]=list_create_11)  # CPython3
# ---------- make_htmlStr.python (59 lines) ----------
# Load the Python Standard and DesignScript Libraries
import sys
import clr
clr.AddReference('ProtoGeometry')
from Autodesk.DesignScript.Geometry import *

# The inputs to this node will be stored as a list in the IN variables.
dataEnteringNode = IN
jsPart = IN[0]
cssPart = IN[1]
navPart = IN[2]

pjtName = IN[3][0]
bdName = IN[3][1]
pages = IN[4]

homePage = pages[0]



# Place your code below this line
##folderPath_r = folderPath.replace('\\','\\\\')

htmlStr = f'''
<!DOCTYPE html>
<html lang="ko">

<head>
    <link rel="shortcut icon" href="#">
    <meta charset="UTF-8">
    <title>RVT Calculation Result</title>
    <style>
        {cssPart}
    </style>
</head>

<header>
<h5>Revit Elements' Bill of Quantities Page</h5>
<h4>{pjtName}</h4>
<h4>{bdName}</h4>
</header>

<body>
{navPart}

<div id="homePage">
{homePage}
</div>



<script type ="module" src="./js/script.js"></script>

</body>

</html>
'''
# Assign your output to the OUT variable.
OUT = htmlStr
# ----------------------------------------
code_block_79 = CodeBlock(htmlStr=make_htmlStr) { htmlStr; }
serverFilePath = CodeBlock { ".dynTemp"; }
htmlPath = Python(IN[0]=serverFilePath)  # CPython3
# ---------- htmlPath.python (35 lines) ----------
# Load the Python Standard and DesignScript Libraries
import sys
import clr
clr.AddReference('ProtoGeometry')
from Autodesk.DesignScript.Geometry import *
import time
import subprocess
import os

clr.AddReference('RevitNodes')
import Revit
clr.ImportExtensions(Revit.Elements)
from Revit import Elements
# The inputs to this node will be stored as a list in the IN variables.
dataEnteringNode = IN
dynTempServerPath = IN[0]
# Place your code below this line
def find_cwd():
    doc = Revit.Application.Document.Current
    filePath_string = doc.FilePath
    folderPath = filePath_string.split('\\')
    folderPath.pop(-1)
    folderPath_str = '\\'.join(folderPath)
    return folderPath_str

cwd = find_cwd()
#cwd = os.getenv("HomePath")

folderPath = f"{cwd}\\{dynTempServerPath}\\tmpForBOQ"
if not os.path.exists(folderPath):
    os.makedirs(folderPath)

# Assign your output to the OUT variable.
#OUT = "C:"+folderPath
OUT = folderPath
# ----------------------------------------
n0_set_port_number_기본값_8000_작동_오류 = StringInput("8000")  # "0. Set Port Number: 기본값-8000 (작동 오류 없다면 변경 금지)"; graph input
create_html_file_and_open = Python(IN[0]=code_block_79, IN[1]=htmlPath, IN[2]=n0_set_port_number_기본값_8000_작동_오류)  # CPython3
# ---------- create_html_file_and_open.python (85 lines) ----------
# Load the Python Standard and DesignScript Libraries
import os
import sys
import clr
clr.AddReference('ProtoGeometry')
from Autodesk.DesignScript.Geometry import *

clr.AddReference('RevitNodes')
import Revit
clr.ImportExtensions(Revit.Elements)
from Revit import Elements

import time
import subprocess
import asyncio
import multiprocessing

#################################Module For Functional Programing#############################################
from functools import reduce
curry = lambda f: lambda a,*args: f(a, *args) if (len(args)) else lambda *args: f(a, *args)

filter = curry(filter)
map = curry(map)

def _take(length, iter):
    res = []
    for a in iter:
        res.append(a)
        if len(res) == length:
            return res
        
take = curry(_take)
reduce = curry(reduce)

go = lambda *args: reduce(lambda a,f: f(a), args) ## 함수도 축약 가능 ##
##############################################################################################################

# The inputs to this node will be stored as a list in the IN variables.
dataEnteringNode = IN
contents = IN[0]
folderPath = IN[1]
cwd = folderPath
portNo = IN[2]
#bdName = IN[2]
# Place your code below this line

def find_cwd():
    doc = Revit.Application.Document.Current
    filePath_string = doc.FilePath
    folderPath = filePath_string.split('\\')
    folderPath.pop(-1)
    folderPath_str = '\\'.join(folderPath)
    return folderPath_str

def make_resultHTMLname(htmlStr,title,cwd):
    timeStamp = time.strftime('%H_%M_%S', time.localtime(time.time()))
    #folderPath = f"{cwd}\\.dynLog"
    folderPath = cwd
    if not os.path.exists(folderPath):
        os.makedirs(folderPath)
    fileName = f"index.html"
    filePath = f"{folderPath}\\" + fileName
    f = open(filePath, 'w', encoding='utf8')
    f.write(htmlStr)
    f.close()
    return fileName


def execute_browser(cwd):
    #cwd = find_cwd()
    folderPath = cwd
    os.chdir(folderPath)
    #cmdStr = "start chrome http:localhost:8000"
    cmdStr = f"start msedge http:localhost:{portNo}"
    cmdList= cmdStr.split(' ')
    #subprocess.run(args=[fileName], shell=True)
    #subprocess.run(args=['start','excel',fileName], shell=True)
    subprocess.run(args=cmdList, shell=True)
    return cmdList


fileName = make_resultHTMLname(contents,"test",cwd)

# Assign your output to the OUT variable.
OUT = execute_browser(cwd)#fileName.split('.')[0]
# ----------------------------------------
create_js_file = Python(IN[0]=javascriptPart, IN[1]=htmlPath)  # CPython3; unwired: IN[2]
# ---------- create_js_file.python (84 lines) ----------
# Load the Python Standard and DesignScript Libraries
import os
import sys
import clr
clr.AddReference('ProtoGeometry')
from Autodesk.DesignScript.Geometry import *

clr.AddReference('RevitNodes')
import Revit
clr.ImportExtensions(Revit.Elements)
from Revit import Elements

import time
import subprocess

#################################Module For Functional Programing#############################################
from functools import reduce
curry = lambda f: lambda a,*args: f(a, *args) if (len(args)) else lambda *args: f(a, *args)

filter = curry(filter)
map = curry(map)

def _take(length, iter):
    res = []
    for a in iter:
        res.append(a)
        if len(res) == length:
            return res
        
take = curry(_take)
reduce = curry(reduce)

go = lambda *args: reduce(lambda a,f: f(a), args) ## 함수도 축약 가능 ##
##############################################################################################################

# The inputs to this node will be stored as a list in the IN variables.
dataEnteringNode = IN
contents = IN[0]
folderPath = IN[1]
#bdName = IN[2]
# Place your code below this line
def find_cwd():
    doc = Revit.Application.Document.Current
    filePath_string = doc.FilePath
    folderPath = filePath_string.split('\\')
    folderPath.pop(-1)
    folderPath_str = '\\'.join(folderPath)
    return folderPath_str

#cwd = find_cwd()
cwd = folderPath

def make_resultHTMLname(jsStr,cwd):
    #timeStamp = time.strftime('%H_%M_%S', time.localtime(time.time()))
    #folderPath = f"{cwd}\\.dynLog"
    folderPath = cwd
    jsPath = cwd + "\\js"
    if not os.path.exists(folderPath):
        os.makedirs(folderPath)
    if not os.path.exists(jsPath):
        os.makedirs(jsPath)
    fileName = "script.js"
    filePath = f"{jsPath}\\" + fileName
    f = open(filePath, 'w', encoding='utf8')
    f.write(jsStr)
    f.close()
    return fileName

def execute_file(fileName):
    #cwd = find_cwd()
    folderPath = cwd
    os.chdir(folderPath)
    subprocess.run(args=[fileName], shell=True)
    #subprocess.run(args=['start','excel',fileName], shell=True)
    

fileName = make_resultHTMLname(contents,cwd)
#fileName = "Test1.html"

#execute_file(fileName)


# Assign your output to the OUT variable.
OUT = fileName
# ----------------------------------------
start_webserver = Python(IN[0]=htmlPath, IN[1]=n0_set_port_number_기본값_8000_작동_오류)  # CPython3
# ---------- start_webserver.python (48 lines) ----------
# Load the Python Standard and DesignScript Libraries
import sys
import clr
clr.AddReference('ProtoGeometry')
from Autodesk.DesignScript.Geometry import *

import os
import asyncio
import multiprocessing
import subprocess
# The inputs to this node will be stored as a list in the IN variables.
dataEnteringNode = IN
cwd = IN[0]
portNo = IN[1]
# Place your code below this line
batStr = f"""
@echo on
python -m http.server {portNo}
cmd /k
"""
##cmd /k
title = "localWebserver"

def make_startSever_bat(batStr,title,cwd):
    folderPath = cwd
    if not os.path.exists(folderPath):
        os.makedirs(folderPath)
    fileName = f"{title}.bat"
    filePath = f"{folderPath}\\" + fileName
    f = open(filePath, 'w', encoding='utf8')
    f.write(batStr)
    f.close()
    return fileName

def startBat(fileName, cwd):
    cmdStr = f".\\{fileName}"
    cmdList= cmdStr.split(' ')
    os.chdir(cwd)
    
    res = subprocess.Popen(args=cmdList, shell=True)
    return res

batFileName = make_startSever_bat(batStr,title,cwd)
#res = multiprocessing.Process(name="SubProcess", target=startBat, args=(batFileName, cwd))
# Assign your output to the OUT variable.
OUT = startBat(batFileName, cwd)

#startBat(fileName, cwd)
# ----------------------------------------
make_htmlStr_2 = Python(IN[0]=javascriptPart, IN[1]=cssPart)  # CPython3; unwired: IN[2]
# ---------- make_htmlStr_2.python (53 lines) ----------
# Load the Python Standard and DesignScript Libraries
import sys
import clr
clr.AddReference('ProtoGeometry')
from Autodesk.DesignScript.Geometry import *

# The inputs to this node will be stored as a list in the IN variables.
dataEnteringNode = IN
jsPart = IN[0]
cssPart = IN[1]
tablePart = IN[2]

# Place your code below this line
##folderPath_r = folderPath.replace('\\','\\\\')

htmlStr = f'''
<!DOCTYPE html>
<html lang="ko">

<head>
    <meta charset="UTF-8">
    <title>my first three.js app</title>
    <style>
        {cssPart}
    </style>
</head>

<body>


<div class="wrapper">

  <a data-fslightbox="gallery" href="#custom-source">
    유튜브 라이트박스
  </a>

  <iframe id="custom-source"
          frameborder="0"
          width="1920px"
          height="1080px"
          allow="autoplay; fullscreen"
          src="https://www.youtube.com/embed/qgBSiRwsbNw?autoplay=1">
  </iframe>
</div>

<script src="https://cdnjs.cloudflare.com/ajax/libs/fslightbox/3.3.1/index.min.js" integrity="sha512-EqNNJuepkw5P9vxCml8eBk7C4Ld+4kAnvzOD/jG21rkxWPILGoQa5EvD62UieiJF0u3xoQrcVnce4i83VnYj/Q==" crossorigin="anonymous" referrerpolicy="no-referrer"></script>

</body>

</html>
'''
# Assign your output to the OUT variable.
OUT = htmlStr
# ----------------------------------------

code_block_80 = CodeBlock { "Type"; }
getParameterValueByName_5 = Element.GetParameterValueByName(element=join, parameterName=code_block_80)
parameters_2 = Element.Parameters(element=join)
warningForNoTypeNames = Python(IN[0]=allElemsDict_2)  # CPython3; frozen; starter script, not edited (OUT = 0)
code_block_81 = CodeBlock(i=code_block_66) { i["wms"]["wmSpecs"]; }
code_block_82 = CodeBlock(i=code_block_81) { i["Quantity"]; }
values = DesignScript.Builtin.Dictionary.Values(dictionary=code_block_67)
code_block_83 = CodeBlock(i=wm별_spec_정리_from_family_list) { i["catStr"]; }
code_block_84 = CodeBlock(i=allElemsDict_2) { i["wms"]["Family Type Name"]; }
code_block_85 = CodeBlock(i=토공_계산_1_1_3) { i["earthQty"]?i["earthQty"]:{}; }  # frozen
code_block_86 = CodeBlock(i=code_block_85) { i["exca_above"]?i["exca_above"]:0; }
sum = Math.Sum(values=code_block_86)
code_block_87 = CodeBlock(i=code_block_85) { i["exca_below"]?i["exca_below"]:0; }
sum_2 = Math.Sum(values=code_block_87)
code_block_88 = CodeBlock(a=sum, b=sum_2) { a+b; }
code_block_89 = CodeBlock(i=code_block_85) { i["disposal"]?i["disposal"]:0; }
sum_3 = Math.Sum(values=code_block_89)
code_block_90 = CodeBlock(i=code_block_85) { i["backfill"]?i["backfill"]:0; }
sum_4 = Math.Sum(values=code_block_90)
code_block_91 = CodeBlock(a=sum_3, b=sum_4) { a+b; }
code_block_92 = CodeBlock { "온통터파기"; }
code_block_93 = CodeBlock(i=wm별_계산결과_및_spec_정리_from_element) { i["Description"]; }
code_block_94 = CodeBlock(i=wm별_계산결과_및_spec_정리_from_element) { i["Work Master Code"]; }
code_block_95 = CodeBlock(i=wm별_spec_정리_from_family_list) { i["Description"]; }
code_block_96 = CodeBlock(i=토공_계산_1_1_3) { i["earthInfo"]; }  # frozen
code_block_97 = CodeBlock(i=code_block_96) { i["btmZ"]; }
code_block_98 = CodeBlock(i=code_block_27.out0) { i; }
categories_7 = Categories("OST_GenericModel")
code_block_99 = CodeBlock { "H_ExcaShape"; }
byGeometry = DirectShape.ByGeometry(geometry=code_block_98, category=categories_7, name=code_block_99)
토공_계산_1_1_2_debug = Python(IN[0]=code_block_21, IN[1]=code_block_22, IN[2]=allElemsDict, IN[3]=code_block_26, IN[4]=elevation)  # CPython3; frozen; same code as 토공_계산_1_1_3
select_model_element = DSModelElementSelection()  # 1 picked in the model
parameters_3 = Element.Parameters(element=select_model_element)
basePoint = Coordinates.BasePoint()
surveyPoint = Coordinates.SurveyPoint()
byGeometry_2 = BoundingBox.ByGeometry()  # unwired: geom
byMinimumVolume = BoundingBox.ByMinimumVolume()  # unwired: geom
토공_계산_1_1_2 = Python(IN[0]=code_block_21, IN[1]=code_block_22, IN[2]=allElemsDict, IN[3]=code_block_26, IN[4]=elevation)  # CPython3; frozen
# ---------- 토공_계산_1_1_2.python (584 lines) ----------
# Load the Python Standard and DesignScript Libraries
import sys
import clr
clr.AddReference('ProtoGeometry')
from Autodesk.DesignScript.Geometry import *

import Revit

################Module For Functional Programing##########################
from functools import reduce
from itertools import chain
from itertools import groupby
from copy import deepcopy
curry = lambda f: lambda a,*args: f(a, *args) if (len(args)) else lambda *args: f(a, *args)

filter = curry(filter)
map = curry(map)
reduce = curry(reduce)

go = lambda *args: reduce(lambda a,f: f(a), args) ## 함수도 축약 가능 ##

def dictUpdate(dic1,dic2):
    res = dic1.update(dic2)
    #res = {**dic1,**dic2}
    return dic1 #res
    
def dictsMerge(dics):
    res = reduce(dictUpdate, dics)
    return res
    
def dictDeleteKeys(dic, keys):
    for k in keys:
        del dic[k]
    return dic
##########################################################################

# The inputs to this node will be stored as a list in the IN variables.
dataEnteringNode = IN
calcMode = IN[0]
excaMode = IN[1]
elemDicts = IN[2]
earth_CommonInfoDict = IN[3]
FL_Z = IN[4]
#test_sample = elemDicts[303]

# Place your code below this line
LD = earth_CommonInfoDict["LD"]
BasePoint_Calibration = Revit.Elements.Coordinates.BasePoint().Z
#GL = Revit.Elements.Coordinates.BasePoint().Z - LD * 1000
GL = FL_Z - BasePoint_Calibration - LD * 1000

GWL_ = earth_CommonInfoDict["GWL"] * 1000

GWL = earth_CommonInfoDict["GWL"] * 1000# - BasePoint_Calibration

GWLplane = Plane.ByOriginNormal(Point.ByCoordinates(0,0,GWL_ + BasePoint_Calibration), Vector.ByCoordinates(0,0,1))

def find_belowSrf_simple(elem):
    res = go(
        elem.Geometry(),
        map(BoundingBox.ByGeometry), map(BoundingBox.ToCuboid),
        map(lambda x: x.Explode()),
        lambda x: list(chain(*x)),
        filter(lambda x: x.NormalAtParameter(0.5,0.5).Z < -0.1),list,
    )
    if res:
        return res

def find_belowSrf_complex(elem):
    res = go(
        elem.Geometry(),
        #map(BoundingBox.ByGeometry), map(BoundingBox.ToCuboid),
        map(lambda x: x.Explode()),
        lambda x: list(chain(*x)),
        filter(lambda x: x.NormalAtParameter(0.5,0.5).Z < -0.1),list,
    )
    if res:
        return res
        
def find_aboveSrf_simple(elem):
    res = go(
        elem.Geometry(),
        map(BoundingBox.ByGeometry), map(BoundingBox.ToCuboid),
        map(lambda x: x.Explode()),
        lambda x: list(chain(*x)),
        filter(lambda x: x.NormalAtParameter(0.5,0.5).Z == 1),list,
    )
    if res:
        return res
        
def add_defaultEarthInfo(elemDict, GWL, GL, BasePoint_Calibration):
    elem = elemDict["Elem"]
    if "_ExcaTgt" in elemDict["wms"]["Family Type Name"]:
        btmSrfs = find_belowSrf_complex(elem)
        btmSrfs = btmSrfs if btmSrfs else []
    else:
        btmSrfs = find_belowSrf_simple(elem)
        btmSrfs = btmSrfs if btmSrfs else []
    uprSrfs = find_aboveSrf_simple(elem)
    uprSrfs = uprSrfs if uprSrfs else []
    
    try:    
        if "Lean" not in elemDict["wms"]["Family Type Name"]:
            leanThk = elemDict["wms"]["Post_Sym_Val Dict"]["C1"] * 1000
            baseThk = elemDict["wms"]["Post_Sym_Val Dict"]["C2"] * 1000
            subBaseThk = elemDict["wms"]["Post_Sym_Val Dict"]["C3"] * 1000
            extraThk = elemDict["wms"]["Post_Sym_Val Dict"]["C4"] * 1000
        else:
            leanThk  = 0
            baseThk = elemDict["wms"]["Post_Sym_Val Dict"]["C2"] * 1000
            subBaseThk = elemDict["wms"]["Post_Sym_Val Dict"]["C3"] * 1000
            extraThk = elemDict["wms"]["Post_Sym_Val Dict"]["C4"] * 1000
    except:
        leanThk  = 0
        baseThk = 0
        subBaseThk = 0
        extraThk = 0
        

    base_downHeight = leanThk + baseThk + subBaseThk + extraThk
    
    btmZ = min( list(map(lambda x: x.PointAtParameter(0.5,0.5).Z, btmSrfs))\
                        if btmSrfs else [0] ) - BasePoint_Calibration
    uprZ = max( list(map(lambda x: x.PointAtParameter(0.5,0.5).Z, uprSrfs))\
                        if uprSrfs else [0] ) - BasePoint_Calibration
    
    btmArea = sum(list(map(lambda x: x.Area, btmSrfs)))
    elem_Volume = btmArea * abs(uprZ - btmZ) / 1000000000
    Btm_toGWL_volume = btmArea * ( GWL - (btmZ - base_downHeight) ) / 1000000000
    GWL_toGL_volume = btmArea * ( GL - GWL ) / 1000000000
    Btm_toGL_volume = btmArea * ( GL - (btmZ - base_downHeight) ) / 1000000000
    
    res = {
        "isExca": False,
        "btmSrfs": btmSrfs,
        "uprSrfs": uprSrfs,
        "btmArea": btmArea,
        "btmZ": btmZ,
        "uprZ": uprZ,
        "elem_Volume": elem_Volume,
        "Btm_toGWL_volume": Btm_toGWL_volume\
                            if Btm_toGWL_volume > 0 else 0 ,
        "GWL_toGL_volume": GWL_toGL_volume\
                            if GWL_toGL_volume > 0 else 0 ,
        "Btm_toGL_volume": Btm_toGL_volume\
                            if Btm_toGL_volume > 0 else 0 ,
    }
    
    
    elemDict["earthInfo"] = res
    return elemDict

def filter_EarthworkCalcTarget(elemDicts, GWL, GL, BasePoint_Calibration):
    ruleCondition = lambda x:\
        "H1_" in x["wms"]["Family Type Name"] or\
        "S18_Shallow" in x["wms"]["Family Type Name"] or\
        "S18_W" in x["wms"]["Family Type Name"] or\
        "S18_MAT" in x["wms"]["Family Type Name"] or\
        "B01_MAT" in x["wms"]["Family Type Name"] or\
        "S18_Wall" in x["wms"]["Family Type Name"] or\
        "B01" in x["wms"]["Family Type Name"] or\
        "B08_UG RC Slab" in x["wms"]["Family Type Name"] or\
        "B08_Ext Wall_RC_UG_Pit" in x["wms"]["Family Type Name"] or\
        "S16_UG" in x["wms"]["Family Type Name"] or\
        "S16_TG" in x["wms"]["Family Type Name"] or\
        "S17_SOG" in x["wms"]["Family Type Name"] or\
        "S17_Gr" in x["wms"]["Family Type Name"] or\
        "S17_EQ-Pad" in x["wms"]["Family Type Name"] or\
        "S17_Edge" in x["wms"]["Family Type Name"] or\
        "S17_Suspend" in x["wms"]["Family Type Name"] or\
        "S15_UG" in x["wms"]["Family Type Name"] or\
        "B08_Stoop" in x["wms"]["Family Type Name"] or\
        "B08_Ramp" in x["wms"]["Family Type Name"] or\
        "_ExcaTgt" in x["wms"]["Family Type Name"]
    res = go(
        elemDicts,
        filter(lambda x: ruleCondition(x)),
        map( lambda x: add_defaultEarthInfo(x, GWL, GL, BasePoint_Calibration) ),
        list,
    )
    remain = go(
        elemDicts,
        filter(lambda x: not ruleCondition(x)),
        list,
    )
    return res, remain


def filter_ExcaTarget(earthworkCalcTargets):
    res = go(
        earthworkCalcTargets,
        filter(lambda x:
            "B08_Ext Wall" not in x["wms"]["Family Type Name"] and
            "B02_Ext Wall" not in x["wms"]["Family Type Name"] and
            "S15_UG" not in x["wms"]["Family Type Name"]
        ),
        list,
    )
    for x in res:
        x["earthInfo"]["isExca"] = True
    return res


def find_eachExcaShape(elemDict, GWL, GL, LD, BasePoint_Calibration):
    belowSrfs = elemDict["earthInfo"]["btmSrfs"]
    btm_GL_Z = elemDict["earthInfo"]["btmZ"]
    G = elemDict["wms"]["Post_Sym_Val Dict"]["G"]
    GL_FL_gap = LD
    
    if "Lean" not in elemDict["wms"]["Family Type Name"]:
        leanThk = elemDict["wms"]["Post_Sym_Val Dict"]["C1"] * 1000
    else:
        leanThk  = 0
        
    baseThk = elemDict["wms"]["Post_Sym_Val Dict"]["C2"] * 1000
    subBaseThk = elemDict["wms"]["Post_Sym_Val Dict"]["C3"] * 1000
    extraThk = elemDict["wms"]["Post_Sym_Val Dict"]["C4"] * 1000
    base_downHeight = leanThk + baseThk + subBaseThk + extraThk
    
    if btm_GL_Z < -0.1:
        excaHeight = (-btm_GL_Z + base_downHeight)
    else:
        excaHeight = base_downHeight
        
    leanOffset = elemDict["wms"]["Post_Sym_Val Dict"]["D1"] * 1000
    excaOffset = elemDict["wms"]["Post_Sym_Val Dict"]["D2"] * 1000
    belowOffset = leanOffset + excaOffset
    #upperOffset = G * excaHeight
    upperOffset = G * excaHeight + belowOffset
    
    find_belowRef = lambda belowSrf: go(
        belowSrf,
        lambda x: x.Translate(0, 0, -base_downHeight),
        lambda x: x.PerimeterCurves(),
        PolyCurve.ByJoinedCurves,
        lambda x: x.OffsetMany(-belowOffset, False, Vector.ZAxis()),
        lambda x: x[0],
        Surface.ByPatch,
        BoundingBox.ByGeometry,
        lambda x: [x.MinPoint, x.MaxPoint],
        lambda x: Cuboid.ByCorners(*x),
        lambda x: x.Explode()[0],
        lambda x: x.PerimeterCurves(),
        PolyCurve.ByJoinedCurves,
    )
    
    find_upperRef = lambda belowSrf: go(
        belowSrf,
        lambda x: x.Translate(0, 0, -btm_GL_Z - LD*1000),
        lambda x: x.PerimeterCurves(),
        PolyCurve.ByJoinedCurves,
        lambda x: x.OffsetMany(-upperOffset, False, Vector.ZAxis()),
        lambda x: x[0],
        Surface.ByPatch,
        BoundingBox.ByGeometry,
        lambda x: [x.MinPoint, x.MaxPoint],
        lambda x: Cuboid.ByCorners(*x),
        lambda x: x.Explode()[0],
        lambda x: x.PerimeterCurves(),
        PolyCurve.ByJoinedCurves,
    )
    
    belowRefs = list(map(find_belowRef, belowSrfs))
    upperRefs = list(map(find_upperRef, belowSrfs))
    exca_RefGroups = list(zip(belowRefs,upperRefs))
    exca_Shape = Solid.ByUnion( map(Solid.ByLoft, exca_RefGroups) )
    
    return exca_Shape

def find_unionExcaShape(excaTargets, GWL, GL, LD, BasePoint_Calibration):
    excaSolids = []
    for elemDict in excaTargets:
        excaSolids.append( find_eachExcaShape(elemDict, GWL, GL, LD, BasePoint_Calibration) )
        res = Solid.ByUnion(excaSolids)
    return res
    
def find_unionExcaShape_whole(
        excaTargets, 
        GWL, 
        GL, 
        LD, 
        earth_CommonInfoDict, 
        BasePoint_Calibration
    ):
    
    allElems = list(map(lambda x: x["Elem"], excaTargets))
    def makeBdCube(e):
        eGeo = e.Geometry()[0]
        eBdBoxCube = BoundingBox.ByGeometry(eGeo).ToCuboid()
        return eBdBoxCube
    
    def find_elemsGeo(allElems):
        #flatten_Elems = list(chain(*excaTargets))
        allGeo = []
        for e in allElems:
            try:
                allGeo.append(makeBdCube(e))
            except:
                pass
        return allGeo
        
    def findWholeBdBox(allElems):
        allGeo = find_elemsGeo(allElems)
        unionBdCube = BoundingBox.ByGeometry(allGeo).ToCuboid()
        return unionBdCube
    
    find_belowRef = lambda belowSrf: go(
        belowSrf,
        lambda x: x.Translate(0, 0, -base_downHeight),
        lambda x: x.PerimeterCurves(),
        PolyCurve.ByJoinedCurves,
        lambda x: x.OffsetMany(-belowOffset, False, Vector.ZAxis()),
        lambda x: x[0],
        Surface.ByPatch,
        BoundingBox.ByGeometry,
        lambda x: [x.MinPoint, x.MaxPoint],
        lambda x: Cuboid.ByCorners(*x),
        lambda x: x.Explode()[0],
        lambda x: x.PerimeterCurves(),
        PolyCurve.ByJoinedCurves,
    )
    
    find_upperRef = lambda belowSrf: go(
        belowSrf,
        lambda x: x.Translate(0, 0, -btm_GL_Z - LD*1000),
        lambda x: x.PerimeterCurves(),
        PolyCurve.ByJoinedCurves,
        lambda x: x.OffsetMany(-upperOffset, False, Vector.ZAxis()),
        lambda x: x[0],
        Surface.ByPatch,
        BoundingBox.ByGeometry,
        lambda x: [x.MinPoint, x.MaxPoint],
        lambda x: Cuboid.ByCorners(*x),
        lambda x: x.Explode()[0],
        lambda x: x.PerimeterCurves(),
        PolyCurve.ByJoinedCurves,
    )

    unionBdCube = findWholeBdBox(allElems)
    belowSrfs = go(
        [unionBdCube],
        map(BoundingBox.ByGeometry), map(BoundingBox.ToCuboid),
        map(lambda x: x.Explode()),
        lambda x: list(chain(*x)),
        filter(lambda x: x.NormalAtParameter(0.5,0.5).Z < -0.1),list,
    )
    
    btm_GL_Z = min( list(map(lambda x: x.PointAtParameter(0.5,0.5).Z, belowSrfs))\
                        if belowSrfs else [0] ) - BasePoint_Calibration

    G = earth_CommonInfoDict["G"]
    GL_FL_gap = LD
    leanThk = earth_CommonInfoDict["C1"] * 1000
    baseThk = earth_CommonInfoDict["C2"] * 1000
    subBaseThk = earth_CommonInfoDict["C3"] * 1000
    extraThk = earth_CommonInfoDict["C4"] * 1000
    base_downHeight = leanThk + baseThk + subBaseThk + extraThk
    excaHeight = -btm_GL_Z + base_downHeight
    leanOffset = earth_CommonInfoDict["D1"] * 1000
    excaOffset = earth_CommonInfoDict["D2"] * 1000
    belowOffset = leanOffset + excaOffset
    #upperOffset = G * excaHeight
    upperOffset = G * excaHeight + belowOffset

    belowRefs = list(map(find_belowRef, belowSrfs))
    upperRefs = list(map(find_upperRef, belowSrfs))
    exca_RefGroups = list(zip(belowRefs,upperRefs))
    exca_Shape = Solid.ByUnion( map(Solid.ByLoft, exca_RefGroups) )
    
    return exca_Shape
    
def find_disposalShape(elemDict):
    elemDisposal_shape = Solid.ByUnion(list(elemDict["Elem"].Geometry()))
    
    leanThk = elemDict["wms"]["Post_Sym_Val Dict"]["C1"] * 1000
    baseThk = elemDict["wms"]["Post_Sym_Val Dict"]["C2"] * 1000
    subBaseThk = elemDict["wms"]["Post_Sym_Val Dict"]["C3"] * 1000
    extraThk = elemDict["wms"]["Post_Sym_Val Dict"]["C4"] * 1000
    base_downHeight = leanThk + baseThk + subBaseThk + extraThk
    
    belowSrfs = elemDict["earthInfo"]["btmSrfs"]
    offset = elemDict["wms"]["Post_Sym_Val Dict"]["D1"]*1000\
                + (elemDict["wms"]["Post_Sym_Val Dict"]["D2"]/2) *1000
    
    find_nonElemDisposal_belowRefs = lambda belowSrf: go(
        belowSrf,
        lambda x: x.Translate(0, 0, -base_downHeight),
        lambda x: x.PerimeterCurves(),
        PolyCurve.ByJoinedCurves,
        lambda x: x.OffsetMany(-offset, False, Vector.ZAxis()),
        lambda x: x[0],
        Surface.ByPatch,
        BoundingBox.ByGeometry,
        lambda x: [x.MinPoint, x.MaxPoint],
        lambda x: Cuboid.ByCorners(*x),
        lambda x: x.Explode()[0],
        lambda x: x.PerimeterCurves(),
        PolyCurve.ByJoinedCurves,
    )
    find_nonElemDisposal_upperRefs = lambda belowSrf: go(
        belowSrf,
        lambda x: x.PerimeterCurves(),
        PolyCurve.ByJoinedCurves,
        lambda x: x.OffsetMany(-offset, False, Vector.ZAxis()),
        lambda x: x[0],
        Surface.ByPatch,
        BoundingBox.ByGeometry,
        lambda x: [x.MinPoint, x.MaxPoint],
        lambda x: Cuboid.ByCorners(*x),
        lambda x: x.Explode()[0],
        lambda x: x.PerimeterCurves(),
        PolyCurve.ByJoinedCurves,
    )

    nonElemDisposal_belowRefs = list(map(find_nonElemDisposal_belowRefs, belowSrfs))
    nonElemDisposal_upperRefs = list(map(find_nonElemDisposal_upperRefs, belowSrfs))
    nonElemDisposal_RefGroups = list(zip(nonElemDisposal_belowRefs,nonElemDisposal_upperRefs))
    nonElemDisposal_Shape = Solid.ByUnion( map(Solid.ByLoft, nonElemDisposal_RefGroups) )
    disposal_shape = Solid.ByUnion( [elemDisposal_shape, nonElemDisposal_Shape] )
    
    return disposal_shape

def find_unionDisposalShape(earthCalcTargets):
    disposal_Solids = []
    for elemDict in earthCalcTargets:
        try:
            disposal_Solids.append( find_disposalShape(elemDict) )
        except:
            pass
    return Solid.ByUnion(disposal_Solids)
    
def add_dispoAndbackfill_qty_toElemDicts(earthCalcTargets, unionDisposalShape, unionBackfillShape):
    whole_disposalShape_volume = unionDisposalShape.Volume
    whole_backfillShape_volume = unionBackfillShape.Volume
    target = earthCalcTargets
    
    total_toGLvolume = go(
        target,
        map(lambda x: x["earthInfo"]["Btm_toGL_volume"]),
        sum,
    )
    
    def find_asignedQty_elemDict(d, wholeVolume):
        res = go(
            d,
            lambda x: (x["earthInfo"]["Btm_toGL_volume"] / total_toGLvolume) * wholeVolume,
            lambda x: x / 1000000000,
        )
        return res
     
    res = go(
        target,
        map( lambda x: 
            dict( x, **{"earthQty": {
                                        "disposal": find_asignedQty_elemDict(x, whole_disposalShape_volume),
                                        "backfill": find_asignedQty_elemDict(x, whole_backfillShape_volume),
                                    }} ) 
        ),
        list,
    )
    return res
    
def add_above_excavation_qty_toElemDicts(elemDicts, above_GWL_excaShape, below_GWL_excaShape):
    cond_inter_GWL = lambda x: x["earthInfo"]["Btm_toGWL_volume"] != 0 and \
                    x["earthInfo"]["Btm_toGWL_volume"] < x["earthInfo"]["elem_Volume"]
    cond_above_GWL = lambda x: x["earthInfo"]["Btm_toGWL_volume"] == 0
    cond_below_GWL = lambda x: x["earthInfo"]["Btm_toGWL_volume"] != 0 and \
                    x["earthInfo"]["Btm_toGWL_volume"] >= x["earthInfo"]["elem_Volume"]
    
    total_Btm_toGL_volume  = go(
        elemDicts,
        filter(lambda elemDict: elemDict["earthInfo"]["isExca"]),
        filter( lambda elemDict: cond_above_GWL(elemDict) ),
        map(lambda elemDict: elemDict["earthInfo"]["Btm_toGL_volume"]),
        sum,
    )
    total_GWL_toGL_volume  = go(
        elemDicts,
        filter(lambda elemDict: elemDict["earthInfo"]["isExca"]),
        filter( lambda elemDict: cond_inter_GWL(elemDict) or cond_below_GWL(elemDict) ),
        map(lambda elemDict: elemDict["earthInfo"]["GWL_toGL_volume"]),
        sum,
    )
    total_ref_volume = total_Btm_toGL_volume + total_GWL_toGL_volume
    exca_above_total_volume = above_GWL_excaShape.Volume
    exca_below_total_volume = below_GWL_excaShape.Volume
    
    def find_asignedQty_elemDict(elemDict):
        if elemDict["earthInfo"]["isExca"] and cond_inter_GWL(elemDict):
            elemDict["earthQty"]["exca_above"] = ( exca_above_total_volume * (elemDict["earthInfo"]["GWL_toGL_volume"] / total_ref_volume) ) / 1000000000
        elif elemDict["earthInfo"]["isExca"] and cond_above_GWL(elemDict):
            elemDict["earthQty"]["exca_above"] = ( exca_above_total_volume * (elemDict["earthInfo"]["Btm_toGL_volume"] / total_ref_volume) ) / 1000000000
        else:
            elemDict["earthQty"]["exca_above"] = 0.0
        return elemDict
    res = list(map( lambda x: find_asignedQty_elemDict(x), elemDicts ))
    return res

def add_below_excavation_qty_toElemDicts(elemDicts, above_GWL_excaShape, below_GWL_excaShape):
    cond_belowOrInter_GWL = lambda x: x["earthInfo"]["Btm_toGWL_volume"] != 0
    
    total_Btm_toGWL_volume  = go(
        elemDicts,
        filter(lambda elemDict: elemDict["earthInfo"]["isExca"]),
        filter( lambda elemDict: cond_belowOrInter_GWL(elemDict) ),
        map(lambda elemDict: elemDict["earthInfo"]["Btm_toGWL_volume"]),
        sum,
    )
    total_ref_volume = total_Btm_toGWL_volume
    exca_above_total_volume = above_GWL_excaShape.Volume
    exca_below_total_volume = below_GWL_excaShape.Volume
    
    def find_asignedQty_elemDict(elemDict):
        if elemDict["earthInfo"]["isExca"] and cond_belowOrInter_GWL(elemDict):
            elemDict["earthQty"]["exca_below"] = exca_below_total_volume/1000000000 * (elemDict["earthInfo"]["Btm_toGWL_volume"] / total_ref_volume)
        else:
            elemDict["earthQty"]["exca_below"] = 0.0
        return elemDict
    res = list(map( lambda x: find_asignedQty_elemDict(x), elemDicts ))
    return res


earthCalcTargets, remainElemDicts = filter_EarthworkCalcTarget(elemDicts, GWL, GL, BasePoint_Calibration)
excaTargets = filter_ExcaTarget(earthCalcTargets)

if excaMode == "개별터파기":
    unionExcaShape = find_unionExcaShape(excaTargets, GWL, GL, LD, BasePoint_Calibration)
    unionPreDisposalShape = find_unionDisposalShape(earthCalcTargets)
    unionBackfillShape = unionExcaShape.Split(unionPreDisposalShape)[0]
    unionBackfillShape_volume = unionBackfillShape.Volume
    unionDisposalShape = unionExcaShape.Split(unionPreDisposalShape)[1]
    
    if isinstance(unionExcaShape, list) and len(unionExcaShape) ==2:
        above_GWL_excaShape, below_GWL_excaShape = unionExcaShape.Split(GWLplane)
        earthCalcTargets_dispoAndbackfill = add_dispoAndbackfill_qty_toElemDicts(earthCalcTargets, unionDisposalShape, unionBackfillShape)
        earthCalcTargets_aboveExca = add_above_excavation_qty_toElemDicts(earthCalcTargets_dispoAndbackfill, above_GWL_excaShape, below_GWL_excaShape)
        earthCalcTargets_calcFinshed = add_below_excavation_qty_toElemDicts(earthCalcTargets_aboveExca, above_GWL_excaShape, below_GWL_excaShape)
        
        OUT = [earthCalcTargets_calcFinshed + remainElemDicts, unionBackfillShape]
    else:
        above_GWL_excaShape = unionExcaShape
        earthCalcTargets_dispoAndbackfill = add_dispoAndbackfill_qty_toElemDicts(earthCalcTargets, unionDisposalShape, unionBackfillShape)
        earthCalcTargets_aboveExca = add_above_excavation_qty_toElemDicts(earthCalcTargets_dispoAndbackfill, above_GWL_excaShape, above_GWL_excaShape)
        OUT = [earthCalcTargets_aboveExca + remainElemDicts, unionBackfillShape]
    
elif excaMode == "온통터파기":
    unionExcaShape = find_unionExcaShape_whole(excaTargets, GWL, GL, LD, earth_CommonInfoDict)
    unionPreDisposalShape = find_unionDisposalShape(earthCalcTargets)
    unionBackfillShape = unionExcaShape.Split(unionPreDisposalShape)[0]
    unionBackfillShape_volume = unionBackfillShape.Volume
    unionDisposalShape = unionExcaShape.Split(unionPreDisposalShape)[1]
    unionDisposalShape_volume = unionDisposalShape.Volume
    
    if isinstance(unionExcaShape, list) and len(unionExcaShape) ==2:
        above_GWL_excaShape, below_GWL_excaShape = unionExcaShape.Split(GWLplane)
        earthCalcTargets_dispoAndbackfill = add_dispoAndbackfill_qty_toElemDicts(earthCalcTargets, unionDisposalShape, unionBackfillShape)
        earthCalcTargets_aboveExca = add_above_excavation_qty_toElemDicts(earthCalcTargets_dispoAndbackfill, above_GWL_excaShape, below_GWL_excaShape)
        earthCalcTargets_calcFinshed = add_below_excavation_qty_toElemDicts(earthCalcTargets_aboveExca, above_GWL_excaShape, below_GWL_excaShape)
        
        OUT = [earthCalcTargets_calcFinshed + remainElemDicts, unionBackfillShape]
    else:
        above_GWL_excaShape = unionExcaShape
        earthCalcTargets_dispoAndbackfill = add_dispoAndbackfill_qty_toElemDicts(earthCalcTargets, unionDisposalShape, unionBackfillShape)
        earthCalcTargets_aboveExca = add_above_excavation_qty_toElemDicts(earthCalcTargets_dispoAndbackfill, above_GWL_excaShape, above_GWL_excaShape)
        OUT = [earthCalcTargets_aboveExca + remainElemDicts, unionBackfillShape]


#    above_GWL_excaShape, below_GWL_excaShape = unionExcaShape.Split(GWLplane)
#    
#    earthCalcTargets_dispoAndbackfill = add_dispoAndbackfill_qty_toElemDicts(earthCalcTargets, unionDisposalShape, unionBackfillShape)
#    
#    earthCalcTargets_aboveExca = add_above_excavation_qty_toElemDicts(earthCalcTargets_dispoAndbackfill, above_GWL_excaShape, below_GWL_excaShape)
#    earthCalcTargets_calcFinshed = add_below_excavation_qty_toElemDicts(earthCalcTargets_aboveExca, above_GWL_excaShape, below_GWL_excaShape)
#    
#    OUT = earthCalcTargets_calcFinshed + remainElemDicts

# Assign your output to the OUT variable.
#OUT = earthCalcTargets
#OUT = unionExcaShape.Volume/1000000000
#OUT = above_GWL_excaShape.Volume/1000000000, below_GWL_excaShape.Volume/1000000000
#OUT = above_GWL_excaShape, below_GWL_excaShape
#OUT = unionDisposalShape_volume/1000000000, unionBackfillShape_volume/1000000000
#OUT = earthCalcTargets_calcFinshed, []
#OUT = earthCalcTargets_calcFinshed + remainElemDicts
# ----------------------------------------
