# Dynamo graph [H_PAB.RT.Q2]_Revit 물량 산출_[3.2.0]_debug.dyn (Dynamo 2.16.1.2727)
# author: MK Jang
# Auto Calculating the Quantities of each Element As per the Family List

n4_total_boq_sheet_경로_입력 = Filename("..\etc\2024_물량산출 마무리\Total BOQ_blank_팀표준(20241216).xlsx")  # "4. Total BOQ sheet 경로 입력"; graph input; frozen
code_block = CodeBlock(totalBOQpath=n4_total_boq_sheet_경로_입력) { totalBOQpath; }
code_block_2 = CodeBlock(totalBOQpath=code_block) { totalBOQpath; }

# group: All Data In Excel-TEST
n1_family_list_경로_입력 = Filename("..\H_BimNote\fl_lat.xlsx")  # "1. Family List 경로 입력"; graph input
file_from_path = FileObject(path=n1_family_list_경로_입력)
target_sheet_names = CodeBlock()
# ---------- target_sheet_names.designscript (5 lines) ----------
[
"5.P Family"
,"3.S Family"
,"WM-AR"
];
# ----------------------------------------
boolean = BoolSelector(true)
importExcel = Data.ImportExcel(file=file_from_path, sheetName=target_sheet_names, showExcel=boolean)  # frozen
n1_family_list_경로_입력_2 = Filename("..\H_BimNote\SACE2_.bnote")  # "1. Family List 경로 입력"; graph input

code_block_3 = CodeBlock(i=importExcel) { i[-1]; }
code_block_4 = CodeBlock(wm_sheetDatas=code_block_3) { wm_sheetDatas; }
code_block_5 = CodeBlock(wm_sheetDatas=code_block_4) { wm_sheetDatas; }

# group: [WM-AR] 시트 데이터 정리
code_block_6 = CodeBlock(wm_sheetDatas=code_block_5) { wm_sheetDatas; }
code_block_7 = CodeBlock { 3+8; }
getItemAtIndex = List.GetItemAtIndex(list=code_block_6@L2, index=code_block_7)
code_block_8 = CodeBlock { 6; }
dropItems = List.DropItems(list=getItemAtIndex, amount=code_block_8)
uniqueItems = List.UniqueItems(list=dropItems)
code_block_9 = CodeBlock(description판별항목1=uniqueItems) { description판별항목1; }
code_block_10 = CodeBlock { 5+8; }
getItemAtIndex_2 = List.GetItemAtIndex(list=code_block_6@L2, index=code_block_10)
code_block_11 = CodeBlock { 6; }
dropItems_2 = List.DropItems(list=getItemAtIndex_2, amount=code_block_11)
uniqueItems_2 = List.UniqueItems(list=dropItems_2)
code_block_12 = CodeBlock(description판별항목2=uniqueItems_2) { description판별항목2; }

# group: All Elements in Revit
categories = Categories("OST_Rooms")
all_elements_of_category = ElementsOfCategory(Category=categories)
list_create = List.Create(item0=all_elements_of_category)
categories_2 = Categories("OST_Gutter")
all_elements_of_category_2 = ElementsOfCategory(Category=categories_2)
list_create_2 = List.Create(item0=all_elements_of_category_2)
all_elementsexceptrails = Python()  # CPython3; unwired: IN[0]
# ---------- all_elementsexceptrails.python (51 lines) ----------
# Load the Python Standard and DesignScript Libraries
import sys
import clr
clr.AddReference('ProtoGeometry')
from Autodesk.DesignScript.Geometry import *

clr.AddReference('RevitAPI')
from Autodesk.Revit.DB import *
import Autodesk

clr.AddReference('RevitServices')
import RevitServices
from RevitServices.Persistence import DocumentManager
doc = DocumentManager.Instance.CurrentDBDocument

def get_all_BIC():

    db = [
    Autodesk.Revit.DB.BuiltInCategory.OST_Floors,
    Autodesk.Revit.DB.BuiltInCategory.OST_Roofs,
    Autodesk.Revit.DB.BuiltInCategory.OST_Walls,
    Autodesk.Revit.DB.BuiltInCategory.OST_StructuralFoundation,
    Autodesk.Revit.DB.BuiltInCategory.OST_StructuralColumns,
    Autodesk.Revit.DB.BuiltInCategory.OST_StructuralFraming,
    Autodesk.Revit.DB.BuiltInCategory.OST_Ceilings,
    Autodesk.Revit.DB.BuiltInCategory.OST_Doors,
    Autodesk.Revit.DB.BuiltInCategory.OST_Windows,
    Autodesk.Revit.DB.BuiltInCategory.OST_Stairs,
    #Autodesk.Revit.DB.BuiltInCategory.OST_Railings,
    ]
    return db
    
def get_allElems(doc):
    bics = get_all_BIC()
    
    def getElems(x):
        collector = FilteredElementCollector(doc)
        res = collector.OfCategory(x).WhereElementIsNotElementType().ToElements()
        return res

    def getRailElems(x):
        collector = FilteredElementCollector(doc)
        res = collector.OfCategory(x).WhereElementIsNotElementType()
        return res

    res = map(getElems, bics)
#    res = getRailElems(Autodesk.Revit.DB.BuiltInCategory.OST_RailingSystemRail)
    return res


OUT = get_allElems(doc)
# ----------------------------------------
categories_3 = Categories("OST_EdgeSlab")
all_elements_of_category_3 = ElementsOfCategory(Category=categories_3)
list_create_3 = List.Create(item0=all_elements_of_category_3)
categories_4 = Categories("OST_StairsRailing")
all_elements_of_category_4 = ElementsOfCategory(Category=categories_4)
list_create_4 = List.Create(item0=all_elements_of_category_4)
categories_5 = Categories("OST_GenericModel")
all_elements_of_category_5 = ElementsOfCategory(Category=categories_5)
type = Object.Type(object=all_elements_of_category_5)
code_block_13 = CodeBlock(i=type) { i!="Revit.Elements.DirectShape"; }
filterByBoolMask = List.FilterByBoolMask(list=all_elements_of_category_5, mask=code_block_13)
list_create_5 = List.Create(item0=filterByBoolMask.in)
join = List.Join(list0=list_create, list1=list_create_2, list2=all_elementsexceptrails, list3=list_create_3, list4=list_create_4, list5=list_create_5)

# group: 모델링된 모든 객체의 패밀리 타입 명 추출 구간 (Room 객체의 경우 Number 속성값을 합쳐서 이름 추출)
code_block_14 = CodeBlock { "\t"; }
flatten = List.Flatten(list=join)
type_2 = Object.Type(object=flatten)
code_block_15 = CodeBlock(i=type_2) { i=="Revit.Elements.Room"; }
filterByBoolMask_2 = List.FilterByBoolMask(list=flatten, mask=code_block_15)
code_block_16 = CodeBlock { "Number"; "Name"; }
getParameterValueByName = Element.GetParameterValueByName(element=filterByBoolMask_2.in, parameterName=code_block_16.out0)
getParameterValueByName_2 = Element.GetParameterValueByName(element=filterByBoolMask_2.in, parameterName=code_block_16.out1)
list_create_6 = List.Create(item0=getParameterValueByName, item1=getParameterValueByName_2)
transpose = List.Transpose(lists=list_create_6)
join_2 = String.Join(separator=code_block_14, string0=transpose)
code_block_17 = CodeBlock(i=join_2) { i[0]; }
code_block_18 = CodeBlock { "Type"; "Type Name"; }
getParameterValueByName_3 = Element.GetParameterValueByName(element=filterByBoolMask_2.out, parameterName=code_block_18.out0)
getParameterValueByName_4 = Element.GetParameterValueByName(element=getParameterValueByName_3, parameterName=code_block_18.out1)
join_3 = List.Join(list0=code_block_17, list1=getParameterValueByName_4)
list_create_7 = List.Create(item0=join_3, item1=flatten)

# group: Excel Dictionarize & 레빗 객체와 결합 딕셔너리 형성 및 심볼 / 값 추출
familylist_data_dictionarize = Python(IN[0]=importExcel, IN[1]=list_create_7)  # "FamilyList Data Dictionarize_debug2"; CPython3
# ---------- familylist_data_dictionarize.python (353 lines) ----------
# Load the Python Standard and DesignScript Libraries
import sys
import clr
clr.AddReference('ProtoGeometry')
from Autodesk.DesignScript.Geometry import *
import re
import json

################Module For Functional Programing#########################
from functools import reduce
from itertools import chain
from itertools import groupby
from copy import deepcopy

curry = lambda f: lambda a, *args: (
    f(a, *args) if (len(args)) else lambda *args: f(a, *args)
)

filter, map, reduce = curry(filter), curry(map), curry(reduce)

go = lambda *args: reduce(lambda a, f: f(a), args)  ## 함수도 축약 가능 ##


def dictUpdate(dic1, dic2):
    dic1.update(dic2)
    return dic1


def dictsMerge(dics):
    res = reduce(dictUpdate, dics)
    return res


def dictDeleteKeys(dic, keys):
    for k in keys:
        del dic[k]
    return dic


def flat(a):
    if isinstance(a, list):
        for i in a:
            yield from flat(i)
    else:
        yield a


def grpBy(iter, key):
    f, grpKeys, grps = key, [], []
    sorted_ = sorted(iter, key=f)
    for key, grp_data in groupby(sorted_, key=f):
        grpKeys.append(key)
        grps.append(list(grp_data))
    return grps, grpKeys


#########################################################################


# The inputs to this node will be stored as a list in the IN variables.
dataEnteringNode = IN
pjtFamily_sheet_data = IN[0][0]
stdFamily_sheet_data = IN[0][1]
allElems_name = IN[1][0]
allElems = IN[1][1]

# Place your code below this line
def find_hdr_row(sheet_data, identifier):
    res = go(
        sheet_data,
        filter(lambda x: identifier in str(x)),
        filter(lambda x: "No" in str(x) and "Family Name" in str(x)),
        list,
    )
    
    if isinstance(res, list) and len(res)>0:
        return res[0]
    else:
        return res

def find_cat(sheet, selected_row):
    pattern = r'\b\d+\.[A-Za-z]'
    
    crnt_row = selected_row
    if sheet[crnt_row][2] and re.findall(pattern, str(sheet[crnt_row][2])):
        return sheet[crnt_row][2]
    elif crnt_row < 0:
        pass
    else:
        return find_cat(sheet, crnt_row - 1)
        
def find_parent_type(sheet, selected_row):
    pattern = r'\b\d+\.\d+'
    
    crnt_row = selected_row
    if sheet[crnt_row][2] and re.findall(pattern, str(sheet[crnt_row][2])):
        return sheet[crnt_row][3]
    elif crnt_row < 0:
        pass
    else:
        return find_parent_type(sheet, crnt_row - 1)
        
        
def create_typeWM_match_dict_forPjt(sheet_data, hdrs=None):
    if not hdrs:
        hdrs = find_hdr_row(sheet_data, "▣")
    hdr_idx_of_FamilyName = hdrs.index("Family Name")
    
    modi_sheet_data = []
    for idx,row in enumerate(pjtFamily_sheet_data):
        newRow = list(row[:])
        # del newRow[2]
        # newRow.insert(2, find_cat(pjtFamily_sheet_data, idx))
        newRow.append(idx)
        newRow.append(find_cat(pjtFamily_sheet_data, idx))
        newRow.append(find_parent_type(pjtFamily_sheet_data, idx))
        modi_sheet_data.append(newRow)
    
    onlyEffRows = go(
        modi_sheet_data,
        filter(lambda x: "True" in str(x)),
        list,
    )
    
    dics_keys = [
        "Item",
        "WM No.",
        "Work Master",
        "Spec.",
        "Unit",
        "표준 산출식",
        "변경 산출식",
    ]
    
    res = []
    tmp = None
    for row_idx, row_cells in enumerate(onlyEffRows):
        cat = row_cells[-2]
        parent_type = row_cells[-1]
        if "True, True" in str(row_cells):
            if tmp:
                for i in tmp:
                    res.append(i)
            tmp = []
            for famType in row_cells[hdr_idx_of_FamilyName].split(","):
                tmp.append(
                    {
                        "type_name": famType.strip().upper(),
                        "cat": cat,
                        "parent_type": parent_type,
                        "wm_list": []
                    }
                )
        elif "True, True" not in str(row_cells):
            for i in tmp:
                famType = i["type_name"]
                wmDic = {}
                for x in dics_keys:
                    if row_cells[hdrs.index(x)]==None:
                        value = ""
                    else:
                        value = row_cells[hdrs.index(x)]
                    #wmDic.update({x: row_cells[hdrs.index(x)]})
                    wmDic.update({x: value})
                    wmDic.update({"rIDX": row_cells[-3]})
                i["wm_list"].append(wmDic)
            
    return res
    
    # Convert nested dictionary to JSON string before returning
    #return json.dumps(res, ensure_ascii=False, indent=2)
    
def create_typeWM_match_dict_forStd(sheet_data, hdrs=None):
    def filter_hdr_row(row, rng_idx=None):
        res_ = []
        for hdr_idx, hdr in enumerate(row):
            # if hdr!=None and hdr!='-':
            res_.append({hdr: hdr_idx})
        if rng_idx:
            res = res_[rng_idx[0]:rng_idx[1]+1]
        else:
            res = res_
        filter_res = list(filter(lambda hdr: list(hdr.keys())[0]!=None and list(hdr.keys())[0]!='-', res))
        return filter_res
    
    if not hdrs:
        common_hdrs = go(
            sheet_data,
            lambda x: find_hdr_row(x, "Description"),
            lambda x: filter_hdr_row(x, [0,11]),
        )
    # hdr_idx_of_FamilyName = common_hdrs.index("Family Name_Basic (변경 불가)")
    
    def find_hdrs_forType(common_hdrs, row):
        type_hdrs_formula = filter_hdr_row(row, rng_idx=[12,32])
        type_hdrs_paramDict = filter_hdr_row(row, rng_idx=[32,100])
        
        return {
            "표준헤더": common_hdrs,
            "산출식헤더": type_hdrs_formula,
            "매개변수헤더": type_hdrs_paramDict,
        }
        
    header_check = []
    # res = []
    
    res = {}
    type_hdrs=None
    for idx, row in enumerate(sheet_data):
        if row[2]=="#":
            cat = row[3]
            type_hdrs = find_hdrs_forType(common_hdrs, row)
            # header_check.append(find_hdrs_forType(common_hdrs, row))
        else:
            dic = {}
            if type_hdrs:
                for hdr_dic in type_hdrs["표준헤더"]:
                    #value = row[ list(hdr_dic.values())[0] ]
                    dic.update(
                        {
                            list(hdr_dic.keys())[0]: row[ list(hdr_dic.values())[0] ],
                        }
                    )
                form_dic = {}
                for hdr_formulas in type_hdrs["산출식헤더"]:
                    if row[ list(hdr_formulas.values())[0] ] and row[ list(hdr_formulas.values())[0] ]!='-':
                        form_dic.update(
                            {
                                list(hdr_formulas.keys())[0]: row[ list(hdr_formulas.values())[0] ],
                            }
                        )
                
                param_dic = {}
                for hdr_params in type_hdrs["매개변수헤더"]:
                    if row[ list(hdr_params.values())[0] ] and row[ list(hdr_params.values())[0] ]!='-':
                        param_dic.update(
                            {
                                list(hdr_params.keys())[0]: row[ list(hdr_params.values())[0] ],
                            }
                        )

                dic.update(
                    {
                        "formulas": form_dic,
                        "params": param_dic,
                    }
                )
                famName = dic["Family Name_Basic (변경 불가)"]
                res.update(
                    {
                        famName : dic
                    }
                )
    
    return res
    
    # Convert nested dictionary to JSON string before returning
    #return json.dumps(res, ensure_ascii=False, indent=2)
    
def insert_paramDic_toPjt_typeWM_match_dicts(pjt_typeWM_match_dicts, std_typeWM_match_dicts):
    for dic in pjt_typeWM_match_dicts:
        type_name = dic["type_name"]
        parent_typeName = dic["parent_type"]
        paramDic = std_typeWM_match_dicts[parent_typeName]["params"]
        dic.update(
            {
                "params": paramDic
            }
        )
        # print(dic)
    return pjt_typeWM_match_dicts
    #return json.dumps(pjt_typeWM_match_dicts, ensure_ascii=False, indent=2)

def get_param_value(elem, name):
    if name not in list(map(lambda x: x.Name, elem.Parameters)):
        calc_v = elem.ElementType.GetParameterValueByName(name)
    elif name == "H_Room H or CH":
        if elem.GetParameterValueByName(name)=="":
            calc_v = elem.GetParameterValueByName("Unbounded Height")
        else:
            calc_v = elem.GetParameterValueByName(name)
    else:
        calc_v = elem.GetParameterValueByName(name)
    
    if calc_v=="":
        calc_v = 0
    
    return round(calc_v,3)

def update_calcResult_typeDict(pjt_typeWM_match_dicts, allElems, allElems_name):
    res = []
    for idx, elem in enumerate(allElems):
        elem_famType_name = allElems_name[idx].upper()
        for typeDict in pjt_typeWM_match_dicts:
            copied_typeDict = deepcopy(typeDict)
            copied_typeDict["GUID"] = elem.GetParameterValueByName("IfcGUID")
            #print(elem.GetParameterValueByName("ifcGUID"))
            if copied_typeDict["type_name"].strip() == elem_famType_name.strip():
                param_names = sorted(typeDict["params"].keys(), key=len, reverse=True)
                #param_names = sorted(copied_typeDict["params"].Keys, key=len, reverse=True)
                param_values = list(map(lambda x: copied_typeDict["params"][x], param_names))
                
                ###### 약자 값 업데이트 구간
                updated_param_values = []
                for param_v in param_values:
                    if not isinstance(param_v, float):
                        updated_param_values.append(get_param_value(elem, param_v))
                    else:
                        updated_param_values.append(param_v)
                copied_typeDict["calc_params"] = dict(zip(param_names,updated_param_values))
                ####### 약자 값 업데이트 구간####
                
                for wm in copied_typeDict["wm_list"]:
                    wm["GaugeCode"] = ""
                    wm["type_name"] = copied_typeDict["type_name"]
                    if wm["변경 산출식"]:
                        formula = str(wm["변경 산출식"])
                    else:
                        formula = str(wm["표준 산출식"])
                    wm["적용 산출식"] = formula
                        
                    tmp_formula = formula
                    
                    if tmp_formula != "=Exca" and tmp_formula != "=Back" and tmp_formula != "=Disp":
                        for n,v in copied_typeDict["calc_params"].items():
                            tmp_formula = tmp_formula.replace(n, str(v))
                        
                        wm["대입 산출식"] = tmp_formula
                        try:
                            wm["계산 결과"] = eval(tmp_formula.strip("="))
                        except:
                            wm["로그"] = "!! 오류 발생 !! 수식 약자 및 파라미터 연동 확인 필요 !!"
                            wm["계산 결과"] = 0
                    else:
                        wm["대입 산출식"] = ""
                        wm["계산 결과"] = ""
                        wm["로그"] = "토공"
                
                res.append(copied_typeDict)
    return res

pjt_typeWM_match_dicts = create_typeWM_match_dict_forPjt(pjtFamily_sheet_data)
std_typeWM_match_dicts = create_typeWM_match_dict_forStd(stdFamily_sheet_data)

res = insert_paramDic_toPjt_typeWM_match_dicts(
    pjt_typeWM_match_dicts, std_typeWM_match_dicts
    )
    

# Assign your output to the OUT variable.


OUT = update_calcResult_typeDict(res, allElems, allElems_name)
# ----------------------------------------
familylist_data_dictionarize_2 = Python(IN[0]=importExcel)  # "FamilyList Data Dictionarize_debug"; CPython3; frozen
# ---------- familylist_data_dictionarize_2.python (281 lines) ----------
# Load the Python Standard and DesignScript Libraries
import sys
import clr
clr.AddReference('ProtoGeometry')
from Autodesk.DesignScript.Geometry import *
import re
import json

################Module For Functional Programing#########################
from functools import reduce
from itertools import chain
from itertools import groupby
from copy import deepcopy

curry = lambda f: lambda a, *args: (
    f(a, *args) if (len(args)) else lambda *args: f(a, *args)
)

filter, map, reduce = curry(filter), curry(map), curry(reduce)

go = lambda *args: reduce(lambda a, f: f(a), args)  ## 함수도 축약 가능 ##


def dictUpdate(dic1, dic2):
    dic1.update(dic2)
    return dic1


def dictsMerge(dics):
    res = reduce(dictUpdate, dics)
    return res


def dictDeleteKeys(dic, keys):
    for k in keys:
        del dic[k]
    return dic


def flat(a):
    if isinstance(a, list):
        for i in a:
            yield from flat(i)
    else:
        yield a


def grpBy(iter, key):
    f, grpKeys, grps = key, [], []
    sorted_ = sorted(iter, key=f)
    for key, grp_data in groupby(sorted_, key=f):
        grpKeys.append(key)
        grps.append(list(grp_data))
    return grps, grpKeys


#########################################################################


# The inputs to this node will be stored as a list in the IN variables.
dataEnteringNode = IN
pjtFamily_sheet_data = IN[0][0]
stdFamily_sheet_data = IN[0][1]

# Place your code below this line
def find_hdr_row(sheet_data, identifier):
    res = go(
        sheet_data,
        filter(lambda x: identifier in str(x)),
        filter(lambda x: "No" in str(x) and "Family Name" in str(x)),
        list,
    )
    
    if isinstance(res, list) and len(res)>0:
        return res[0]
    else:
        return res

def find_cat(sheet, selected_row):
    pattern = r'\b\d+\.[A-Za-z]'
    
    crnt_row = selected_row
    if sheet[crnt_row][2] and re.findall(pattern, str(sheet[crnt_row][2])):
        return sheet[crnt_row][2]
    elif crnt_row < 0:
        pass
    else:
        return find_cat(sheet, crnt_row - 1)
        
def find_parent_type(sheet, selected_row):
    pattern = r'\b\d+\.\d+'
    
    crnt_row = selected_row
    if sheet[crnt_row][2] and re.findall(pattern, str(sheet[crnt_row][2])):
        return sheet[crnt_row][3]
    elif crnt_row < 0:
        pass
    else:
        return find_parent_type(sheet, crnt_row - 1)
        
        
def create_typeWM_match_dict_forPjt(sheet_data, hdrs=None):
    if not hdrs:
        hdrs = find_hdr_row(sheet_data, "▣")
    hdr_idx_of_FamilyName = hdrs.index("Family Name")
    
    modi_sheet_data = []
    for idx,row in enumerate(pjtFamily_sheet_data):
        newRow = list(row[:])
        # del newRow[2]
        # newRow.insert(2, find_cat(pjtFamily_sheet_data, idx))
        newRow.append(idx)
        newRow.append(find_cat(pjtFamily_sheet_data, idx))
        newRow.append(find_parent_type(pjtFamily_sheet_data, idx))
        modi_sheet_data.append(newRow)
    
    onlyEffRows = go(
        modi_sheet_data,
        filter(lambda x: "True" in str(x)),
        list,
    )
    
    dics_keys = [
        "Item",
        "WM No.",
        "Work Master",
        "Spec.",
        "Unit",
        "표준 산출식",
        "변경 산출식",
    ]
    
    res = []
    tmp = None
    for row_idx, row_cells in enumerate(onlyEffRows):
        cat = row_cells[-2]
        parent_type = row_cells[-1]
        if "True, True" in str(row_cells):
            if tmp:
                for i in tmp:
                    res.append(i)
            tmp = []
            for famType in row_cells[hdr_idx_of_FamilyName].split(","):
                tmp.append(
                    {
                        "type_name": famType.strip().upper(),
                        "cat": cat,
                        "parent_type": parent_type,
                        "wm_list": []
                    }
                )
        elif "True, True" not in str(row_cells):
            for i in tmp:
                famType = i["type_name"]
                wmDic = {}
                for x in dics_keys:
                    if row_cells[hdrs.index(x)]==None:
                        value = ""
                    else:
                        value = row_cells[hdrs.index(x)]
                    #wmDic.update({x: row_cells[hdrs.index(x)]})
                    wmDic.update({x: value})
                    wmDic.update({"rIDX": row_cells[-3]})
                i["wm_list"].append(wmDic)
            
    return res
    
    # Convert nested dictionary to JSON string before returning
    #return json.dumps(res, ensure_ascii=False, indent=2)
    
def create_typeWM_match_dict_forStd(sheet_data, hdrs=None):
    def filter_hdr_row(row, rng_idx=None):
        res_ = []
        for hdr_idx, hdr in enumerate(row):
            # if hdr!=None and hdr!='-':
            res_.append({hdr: hdr_idx})
        if rng_idx:
            res = res_[rng_idx[0]:rng_idx[1]+1]
        else:
            res = res_
        filter_res = list(filter(lambda hdr: list(hdr.keys())[0]!=None and list(hdr.keys())[0]!='-', res))
        return filter_res
    
    if not hdrs:
        common_hdrs = go(
            sheet_data,
            lambda x: find_hdr_row(x, "Description"),
            lambda x: filter_hdr_row(x, [0,11]),
        )
    # hdr_idx_of_FamilyName = common_hdrs.index("Family Name_Basic (변경 불가)")
    
    def find_hdrs_forType(common_hdrs, row):
        type_hdrs_formula = filter_hdr_row(row, rng_idx=[12,32])
        type_hdrs_paramDict = filter_hdr_row(row, rng_idx=[32,100])
        
        return {
            "표준헤더": common_hdrs,
            "산출식헤더": type_hdrs_formula,
            "매개변수헤더": type_hdrs_paramDict,
        }
        
    header_check = []
    # res = []
    
    res = {}
    type_hdrs=None
    for idx, row in enumerate(sheet_data):
        if row[2]=="#":
            cat = row[3]
            type_hdrs = find_hdrs_forType(common_hdrs, row)
            # header_check.append(find_hdrs_forType(common_hdrs, row))
        else:
            dic = {}
            if type_hdrs:
                for hdr_dic in type_hdrs["표준헤더"]:
                    #value = row[ list(hdr_dic.values())[0] ]
                    dic.update(
                        {
                            list(hdr_dic.keys())[0]: row[ list(hdr_dic.values())[0] ],
                        }
                    )
                form_dic = {}
                for hdr_formulas in type_hdrs["산출식헤더"]:
                    if row[ list(hdr_formulas.values())[0] ] and row[ list(hdr_formulas.values())[0] ]!='-':
                        form_dic.update(
                            {
                                list(hdr_formulas.keys())[0]: row[ list(hdr_formulas.values())[0] ],
                            }
                        )
                
                param_dic = {}
                for hdr_params in type_hdrs["매개변수헤더"]:
                    if row[ list(hdr_params.values())[0] ] and row[ list(hdr_params.values())[0] ]!='-':
                        param_dic.update(
                            {
                                list(hdr_params.keys())[0]: row[ list(hdr_params.values())[0] ],
                            }
                        )

                dic.update(
                    {
                        "formulas": form_dic,
                        "params": param_dic,
                    }
                )
                famName = dic["Family Name_Basic (변경 불가)"]
                res.update(
                    {
                        famName : dic
                    }
                )
    
    return res
    
    # Convert nested dictionary to JSON string before returning
    #return json.dumps(res, ensure_ascii=False, indent=2)
    
def insert_paramDic_toPjt_typeWM_match_dicts(pjt_typeWM_match_dicts, std_typeWM_match_dicts):
    for dic in pjt_typeWM_match_dicts:
        type_name = dic["type_name"]
        parent_typeName = dic["parent_type"]
        paramDic = std_typeWM_match_dicts[parent_typeName]["params"]
        dic.update(
            {
                "params": paramDic
            }
        )
        # print(dic)
    return pjt_typeWM_match_dicts
    #return json.dumps(pjt_typeWM_match_dicts, ensure_ascii=False, indent=2)

pjt_typeWM_match_dicts = create_typeWM_match_dict_forPjt(pjtFamily_sheet_data)
std_typeWM_match_dicts = create_typeWM_match_dict_forStd(stdFamily_sheet_data)

res = insert_paramDic_toPjt_typeWM_match_dicts(
    pjt_typeWM_match_dicts, std_typeWM_match_dicts
    )
# Assign your output to the OUT variable.


OUT = res
# ----------------------------------------
update_calcResult_typeDict = Python(IN[0]=familylist_data_dictionarize_2, IN[1]=list_create_7)  # CPython3
# ---------- update_calcResult_typeDict.python (141 lines) ----------
# Load the Python Standard and DesignScript Libraries
import sys
import clr
clr.AddReference('ProtoGeometry')
from Autodesk.DesignScript.Geometry import *
import re
import json
import ast

################Module For Functional Programing#########################
from functools import reduce
from itertools import chain
from itertools import groupby
from copy import deepcopy

curry = lambda f: lambda a, *args: (
    f(a, *args) if (len(args)) else lambda *args: f(a, *args)
)

filter, map, reduce = curry(filter), curry(map), curry(reduce)

go = lambda *args: reduce(lambda a, f: f(a), args)  ## 함수도 축약 가능 ##


def dictUpdate(dic1, dic2):
    dic1.update(dic2)
    return dic1


def dictsMerge(dics):
    res = reduce(dictUpdate, dics)
    return res


def dictDeleteKeys(dic, keys):
    for k in keys:
        del dic[k]
    return dic


def flat(a):
    if isinstance(a, list):
        for i in a:
            yield from flat(i)
    else:
        yield a


def grpBy(iter, key):
    f, grpKeys, grps = key, [], []
    sorted_ = sorted(iter, key=f)
    for key, grp_data in groupby(sorted_, key=f):
        grpKeys.append(key)
        grps.append(list(grp_data))
    return grps, grpKeys


#########################################################################
# The inputs to this node will be stored as a list in the IN variables.
dataEnteringNode = IN
#pjt_typeWM_match_dicts_str = IN[0]
#pjt_typeWM_match_dicts = json.loads(pjt_typeWM_match_dicts_str)
pjt_typeWM_match_dicts = IN[0]
allElems_name = IN[1][0]
allElems = IN[1][1]

# Place your code below this line

def get_param_value(elem, name):
    if name not in list(map(lambda x: x.Name, elem.Parameters)):
        calc_v = elem.ElementType.GetParameterValueByName(name)
    elif name == "H_Room H or CH":
        if elem.GetParameterValueByName(name)=="":
            calc_v = elem.GetParameterValueByName("Unbounded Height")
        else:
            calc_v = elem.GetParameterValueByName(name)
    else:
        calc_v = elem.GetParameterValueByName(name)
    
    if calc_v=="":
        calc_v = 0
    
    return round(calc_v,3)

def update_calcResult_typeDict(pjt_typeWM_match_dicts, allElems, allElems_name):
    res = []
    for idx, elem in enumerate(allElems):
        elem_famType_name = allElems_name[idx].upper()
        for typeDict in pjt_typeWM_match_dicts:
            copied_typeDict = dict.copy(typeDict)
            copied_typeDict["GUID"] = elem.GetParameterValueByName("IfcGUID")
            #print(elem.GetParameterValueByName("ifcGUID"))
            if copied_typeDict["type_name"].strip() == elem_famType_name.strip():
                #param_names = sorted(typeDict["params"].keys(), key=len, reverse=True)
                param_names = sorted(copied_typeDict["params"].Keys, key=len, reverse=True)
                param_values = list(map(lambda x: copied_typeDict["params"][x], param_names))
                
                ###### 약자 값 업데이트 구간
                updated_param_values = []
                for param_v in param_values:
                    if not isinstance(param_v, float):
                        updated_param_values.append(get_param_value(elem, param_v))
                    else:
                        updated_param_values.append(param_v)
                copied_typeDict["calc_params"] = dict(zip(param_names,updated_param_values))
                ####### 약자 값 업데이트 구간####
                
                for wm in copied_typeDict["wm_list"]:
                    wm["GaugeCode"] = ""
                    wm["type_name"] = copied_typeDict["type_name"]
                    if wm["변경 산출식"]:
                        formula = str(wm["변경 산출식"])
                    else:
                        formula = str(wm["표준 산출식"])
                    wm["적용 산출식"] = formula
                        
                    tmp_formula = formula
                    
                    if tmp_formula != "=Exca" and tmp_formula != "=Back" and tmp_formula != "=Disp":
                        for n,v in copied_typeDict["calc_params"].items():
                            tmp_formula = tmp_formula.replace(n, str(v))
                        
                        wm["대입 산출식"] = tmp_formula
                        try:
                            wm["계산 결과"] = eval(tmp_formula.strip("="))
                        except:
                            wm["로그"] = "!! 오류 발생 !! 수식 약자 및 파라미터 연동 확인 필요 !!"
                            wm["계산 결과"] = 0
                    else:
                        wm["대입 산출식"] = ""
                        wm["계산 결과"] = ""
                        wm["로그"] = "토공"
                
                res.append(copied_typeDict)
    return res
    # Convert nested dictionary to JSON string before returning
    #return json.dumps(res, ensure_ascii=False, indent=2)
    

# Assign your output to the OUT variable.
OUT = update_calcResult_typeDict(pjt_typeWM_match_dicts, allElems, allElems_name)
# ----------------------------------------

code_block_19 = CodeBlock(i=familylist_data_dictionarize) { i; }  # frozen
calculatedResult = CodeBlock(calculatedResult=code_block_19) { calculatedResult; }
code_block_20 = CodeBlock(finRes=calculatedResult) { finRes; }
code_block_21 = CodeBlock(dictPerElem=code_block_20) { dictPerElem; }
code_block_22 = CodeBlock { 8; }
getItemAtIndex_3 = List.GetItemAtIndex(list=code_block_6@L2, index=code_block_22)
code_block_23 = CodeBlock { 6; }
dropItems_3 = List.DropItems(list=getItemAtIndex_3, amount=code_block_23)
code_block_24 = CodeBlock { 3; }
getItemAtIndex_4 = List.GetItemAtIndex(list=code_block_6@L2, index=code_block_24)
dropItems_4 = List.DropItems(list=getItemAtIndex_4, amount=code_block_23)
make_dict_forWMgrpName = Python(IN[0]=dropItems_3, IN[1]=dropItems_4)  # CPython3
# ---------- make_dict_forWMgrpName.python (23 lines) ----------
# Load the Python Standard and DesignScript Libraries
import sys
import clr
clr.AddReference('ProtoGeometry')
from Autodesk.DesignScript.Geometry import *

# The inputs to this node will be stored as a list in the IN variables.
dataEnteringNode = IN
wm_grp_keys = IN[0]
wm_grp_vals = IN[1]

# Place your code below this line

def make_dict_forWMgrpName(wm_grp_keys, wm_grp_vals):
    eff_wm_grp_keys = filter(lambda x: x!=None, wm_grp_keys)
    eff_wm_grp_vals = filter(lambda x: x!=None, wm_grp_vals)
    res = dict(zip(eff_wm_grp_keys, eff_wm_grp_vals))
    
    return res
    

# Assign your output to the OUT variable.
OUT = make_dict_forWMgrpName(wm_grp_keys, wm_grp_vals)
# ----------------------------------------
insert_wmGrp_toTypeDict = Python(IN[0]=code_block_21, IN[1]=make_dict_forWMgrpName)  # CPython3
# ---------- insert_wmGrp_toTypeDict.python (26 lines) ----------
# Load the Python Standard and DesignScript Libraries
import sys
import clr
clr.AddReference('ProtoGeometry')
from Autodesk.DesignScript.Geometry import *

# The inputs to this node will be stored as a list in the IN variables.
dataEnteringNode = IN
dictsPerType = IN[0]
dict_WMgrpName = IN[1]

# Place your code below this line

def insert_wmGrp_toTypeDict(dictsPerType, dict_WMgrpName):
    for type_dict in dictsPerType:
        for wm_dict in type_dict["wm_list"]:
            try:
                WMgrpName = dict_WMgrpName[wm_dict["WM No."]]
                wm_dict["wm_grp_name"] = WMgrpName
            except:
                wm_dict["wm_grp_name"] = ""
            
    return dictsPerType

# Assign your output to the OUT variable.
OUT = insert_wmGrp_toTypeDict(dictsPerType, dict_WMgrpName)
# ----------------------------------------
code_block_25 = CodeBlock(i=familylist_data_dictionarize_2) { i; }
code_block_26 = CodeBlock(typeDict=code_block_25) { typeDict; }
code_block_27 = CodeBlock(typeDict=code_block_26) { typeDict; }
code_block_28 = CodeBlock()
# ---------- code_block_28.designscript (9 lines) ----------
wmspec_headers = [
    //"Work Master Code" ,"GaugeCode" ,"Unit" ,
    "Work Category-L1"
    ,"Work Category-L2" ,"Work Category-L3" ,"Spec. 1- L4" ,"Spec. 2- L5"
    ,"Spec. 3- L6" ,"Spec. 4- L7" ,"Spec. 5- L8" ,"Spec. 6- L9"
    ,"Spec. 7- L10" ,"Spec. 8- L11" ,"BOQ Spec1" ,"BOQ Spec2" ,"BOQ Spec3"
    ,"BOQ Spec4" ,"BOQ Spec5" ,"BOQ Spec6" ,"BOQ Spec7" ,"BOQ Spec8" ,"BOQ Spec9"
    ,"Work Master Code /w Description", "Description"// ,"입찰_물량산출식" ,"실행_물량산출식" ,"rIDX"
];
# ----------------------------------------
code_block_29 = CodeBlock(wmSpecs_headers=code_block_28) { wmSpecs_headers; }

# group: Total BOQ 엑셀파일 물량 기입 구간
code_block_30 = CodeBlock(totalBOQpath=code_block_2) { totalBOQpath; }
n5_total_boq_내_시트명_입력 = StringInput("(AR) BOQ View (Working)")  # "5. Total BOQ 내 시트명 입력"; graph input
code_block_31 = CodeBlock(filePath=code_block_30, sheetName=n5_total_boq_내_시트명_입력) { filePath; sheetName; }
n6_건물명_입력 = StringInput("Please enter Building Name before running ")  # "6. 건물명 입력"; graph input
list_create_8 = List.Create(item0=code_block_9, item1=code_block_12)
file_from_path_2 = FileObject(path=code_block_30)
code_block_32 = CodeBlock { "(AR) BOQ"; "(AR) BOQ View (Working)"; false; }
# note: Work Master Code
# Gauge Code
# Description : (L03)
# Spec. : (L04~L11)
# Additional Spec : (Description 항목 값)
importExcel_2 = Data.ImportExcel(file=file_from_path_2, sheetName=n5_total_boq_내_시트명_입력, showExcel=code_block_32.out2)
total_boq_데이터_파싱__ar_boq시트 = Python(IN[0]=n6_건물명_입력, IN[1]=list_create_8, IN[2]=importExcel_2)  # CPython3
# ---------- total_boq_데이터_파싱__ar_boq시트.python (162 lines) ----------
# Load the Python Standard and DesignScript Libraries
import sys
import clr
clr.AddReference('ProtoGeometry')
from Autodesk.DesignScript.Geometry import *

from functools import reduce
from functools import partial
from string import ascii_lowercase
import itertools
from itertools import chain
import re
    
#################################Module For Functional Programing#############################################
curry = lambda f: lambda a,*args: f(a, *args) if (len(args)) else lambda *args: f(a, *args)

filter = curry(filter)
map = curry(map)

def _take(length, iter):
    res = []
    for a in iter:
        res.append(a)
        if len(res) == length:
            return res
        
take = curry(_take)
reduce = curry(reduce)

go = lambda *args: reduce(lambda a,f: f(a), args) ## 함수도 축약 가능 ##
##############################################################################################################
def find_IsInStr(target, str):
    if target == None or str == None:
        pass
    else:
        res = target in str
        return res
        
def find_IsInList(List, str):
    if str == None or List == None:
        pass
    else:
        res = str in List
        return res

def find_range_by_columnItem(db, col_idx, sep_rule):
    tdb = list(map(lambda x: x[col_idx], db))
    last_idx_tdb = len(tdb)-1
    tdb_enum = enumerate(tdb)
    res = list(filter(lambda x: find_IsInStr(sep_rule, x[1]), tdb_enum))
    endidxs_tmp= list(map(lambda x: x[0]-1,res))
    #endidxs_tmp= list(map(lambda x: x[0],res))
    endidxs_tmp.pop(0)
    endidxs = endidxs_tmp + [last_idx_tdb]
    famTypeNames = list(map(lambda x: x[1],res))
    famTypeNamesIdxs = list(map(lambda x: x[0],res))
    rangeSttIdxs = list(map(lambda x: x[0]+1,res))
    rangeEndIdxs = endidxs
    result = dict(zip(famTypeNames, zip(famTypeNamesIdxs, zip(rangeSttIdxs,rangeEndIdxs))))
    return result
    
def find_range_by_columnItem_discrim(db, col_idx, 판별항목):
    tdb = list(map(lambda x: x[col_idx], db))
    last_idx_tdb = len(tdb)-1
    tdb_enum = enumerate(tdb)
    res = list(filter(lambda x: find_IsInList(판별항목, x[1]), tdb_enum))
    endidxs_tmp= list(map(lambda x: x[0]-1,res))
    #endidxs_tmp= list(map(lambda x: x[0],res))
    endidxs_tmp.pop(0)
    endidxs = endidxs_tmp + [last_idx_tdb]
    famTypeNames = list(map(lambda x: x[1],res))
    famTypeNamesIdxs = list(map(lambda x: x[0],res))
    rangeSttIdxs = list(map(lambda x: x[0]+1,res))
    rangeEndIdxs = endidxs
    result = dict(zip(famTypeNames, zip(famTypeNamesIdxs, zip(rangeSttIdxs,rangeEndIdxs))))
    return result

# The inputs to this node will be stored as a list in the IN variables.
dataEnteringNode = IN
bd_name = IN[0]
descr판별항목 = IN[1]
판별항목lv1 = descr판별항목[0]
판별항목lv2 = descr판별항목[1]
db = IN[2]


# Place your code below this line
def Is_newSheet(Sheet):
    
    hdrs_withIdx = dict(list(find_headersAtSheet(Sheet).items()) + list(find_headers_Building(Sheet, bd_name).items()))
    datasOnWMCodeCol = list(map(lambda x: x[hdrs_withIdx["Work Master Code"]], Sheet))
    
    p = re.compile('\w{8}-\w{5}')
    IsNewSheet = not(any(list(map(lambda x: p.match(str(x)), datasOnWMCodeCol))))
    
    
    return [IsNewSheet,datasOnWMCodeCol]
    
def find_headersAtSheet(Sheet):
    headers_Sheet = map(lambda x: [x[1].replace("\n",""),x[0]], filter(lambda x: x[1] != None, enumerate(Sheet[2])))
    res = dict(headers_Sheet)
    #del res["_"]
    
    return res
    
def find_headers_Building(Sheet, bd_name):
    headers_bd = map(lambda x: [x[1].replace("\n",""),x[0]], filter(lambda x: x[1] != None, enumerate(Sheet[3])))
    headers_targetBD = list(filter(lambda x: x[0] == bd_name, headers_bd))
    res = {}
    res["targetBD"] = headers_targetBD[0][1]
    return res

def find_rangesAtSheet(Sheet, hdrs_withIdx, 판별항목):
    return find_range_by_columnItem_discrim(Sheet, hdrs_withIdx["Description"], 판별항목)

def get_DataOnRangesAtSheet(Sheet):
    
    hdrs_withIdx = dict(list(find_headersAtSheet(Sheet).items()) + list(find_headers_Building(Sheet, bd_name).items()))
    rgs_v_lv1 = list(map(lambda x: x[1], find_rangesAtSheet(Sheet, hdrs_withIdx, 판별항목lv1).values()))
    rgs_v_lv2 = list(map(lambda x: x[1], find_rangesAtSheet(Sheet, hdrs_withIdx, 판별항목lv2).values()))
    
    idxs_v_lv1 = list(map(lambda x: range(x[0],x[1]+1), rgs_v_lv1))

    datas_lv1 = []
    col_datas = list(map(lambda x: x[hdrs_withIdx["Description"]], Sheet))
    for rg in idxs_v_lv1:
        lv1_str = col_datas[rg[0]-1]
        tmp = []
        for i in rg:
            tmp.append([i, lv1_str, col_datas[i]])
        
        datas_lv1.append(tmp)

    datas_lv2 = []
    for rg in datas_lv1:
        tmp = []
        for idx,v in enumerate(rg):
            if v[2] == None:
                tmp.append([v[0],v[1],tmp[idx-1][2]])
            else:
                tmp.append(v)
        datas_lv2.append(tmp)

    flatten_res = list(chain(*datas_lv2))
    rres = itertools.groupby(flatten_res, lambda x: [x[1], x[2]])
    
    res = {}
    for k, g in rres:
        #print(list(g))
        removedfirstelem_g = list(g)[1:]
        res["_".join(k)] = [removedfirstelem_g[0][0],removedfirstelem_g[-1][0]]
        #res["_".join(k)] = removedfirstelem_g
    
    return res


hdrs_withIdx = dict(list(find_headersAtSheet(db).items()) + list(find_headers_Building(db, bd_name).items()))

if Is_newSheet(db)[0]:
    OUT = hdrs_withIdx, [Is_newSheet(db)[0],get_DataOnRangesAtSheet(db)]
else:
    OUT = hdrs_withIdx, Is_newSheet(db)
# ----------------------------------------
code_block_33 = CodeBlock(i=total_boq_데이터_파싱__ar_boq시트)
# ---------- code_block_33.designscript (3 lines) ----------
i[0];
i[1];
//구간 rIdx;
# ----------------------------------------
total_boq복사_및_경로_반환 = Python(IN[0]=code_block_31.filePath, IN[1]=code_block_33.out1)  # CPython3
# ---------- total_boq복사_및_경로_반환.python (40 lines) ----------
# Load the Python Standard and DesignScript Libraries
import sys
import clr
clr.AddReference('ProtoGeometry')
from Autodesk.DesignScript.Geometry import *
import datetime
import shutil

# The inputs to this node will be stored as a list in the IN variables.
dataEnteringNode = IN
origin_pathStr = IN[0]
IsNewSheet = IN[1][0]
# Place your code below this line

def copy_fromNewSheet():
    now = datetime.datetime.now()
    #strList = origin_pathStr.split('.')
    strList = origin_pathStr.split('\\')
    path = '\\'.join(strList[:-1])
    fileName = strList[-1]
    fileNameList = fileName.split('.')
    
    add_str = now.strftime("%m%d-%I%M%S")
    add_res = "".join(["_",add_str,"."])
    fileNameList.insert(1, add_res)
    fileName_res = "".join(fileNameList)
    res = path + '\\' + fileName_res
    
    source = origin_pathStr
    destination = res
    shutil.copyfile(source, destination)
    
    return res

# Assign your output to the OUT variable.

if IsNewSheet:
    OUT = copy_fromNewSheet()
else:
    OUT = origin_pathStr
# ----------------------------------------
code_block_34 = CodeBlock(dict_groupBy_Sheet_WM=insert_wmGrp_toTypeDict) { dict_groupBy_Sheet_WM; }
wm별_계산결과_및_spec_정리_from_element = Python(IN[0]=code_block_34)  # CPython3; unwired: IN[1]
# ---------- wm별_계산결과_및_spec_정리_from_element.python (86 lines) ----------
# Load the Python Standard and DesignScript Libraries
import sys
import clr
clr.AddReference('ProtoGeometry')
from Autodesk.DesignScript.Geometry import *

import operator
from itertools import groupby
import copy

# The inputs to this node will be stored as a list in the IN variables.
dataEnteringNode = IN
elemDicts = IN[0]
# Place your code below this line
specKeys = [
    "Work Category-L1", "Work Category-L2" ,"Work Category-L3",
    "Spec. 1- L4" ,"Spec. 2- L5"
    ,"Spec. 3- L6" ,"Spec. 4- L7" ,"Spec. 5- L8" ,"Spec. 6- L9"
    ,"Spec. 7- L10" ,"Spec. 8- L11" ,"BOQ Spec1" ,"BOQ Spec2" ,"BOQ Spec3"
    ,"BOQ Spec4" ,"BOQ Spec5" ,"BOQ Spec6" ,"BOQ Spec7" ,"BOQ Spec8" ,"BOQ Spec9"
]

def extractCalcResult(elemDicts, specKeys):
    res = []
    for d in elemDicts:
        #wms = d["wms"]["wmSpecs"]
        wms = d["wm_list"]
        for wm in wms:
            #keys = ["SheetName", "rIDX", "Work Master Code", "Gauge Code", "wmSpecs", "Family Type Name", "calcResult"]
            keys = ["rIDX", "WM No.", "GaugeCode", "계산 결과"]
            vals = list(map(lambda x: wm[x],keys))
            k_v = list(zip(keys, vals))
            res_d = dict(k_v)
            if "Spec." in wm.Keys:
                res_d["Description"] = wm["Spec."]
            else:
                res_d["Description"] = ""
            res_d["wmcANDgauge"] = "".join([wm["WM No."],wm["GaugeCode"]])
            res_d["UoM"] = wm["Unit"]
            res_d["wmSpecs"] = wm["Work Master"][15:]
            res_d["wm_grp_name"] = wm["wm_grp_name"]
            #res_d["wmSpecs"] = list(map(lambda x: wm[x], specKeys))
            res.append(res_d)
        
    return res

def make_dict_groupBy_WM(elemDicts, specKeys):
    extractedDicts = extractCalcResult(elemDicts, specKeys)
    sortedDicts_WMC = sorted(extractedDicts, key=operator.itemgetter("wmcANDgauge"))
    grpDicts_WMC = groupby(sortedDicts_WMC, key=operator.itemgetter("wmcANDgauge"))
    
    res = []
    for k, g in grpDicts_WMC: 
        wmCode = k
        gg = copy.deepcopy(list(g))
        #res.append(gg)
        qtts = map(lambda x: x["계산 결과"] if isinstance(x["계산 결과"],float) or isinstance(x["계산 결과"], int) else 0, gg)
        calcSum = round(sum(qtts),3)
        wmSpecs = gg[0]["wmSpecs"]
        #catStr = "_".join([wmSpecs[0],wmSpecs[1]])
        catStr =  gg[0]["wm_grp_name"]
        
        specOnly = list(filter(lambda x: x!=0, wmSpecs))[3:]
        addSpec = gg[0]["Description"]
        dict_res = {
            "catStr": catStr,
            "Work Master Code": wmCode,
            "Gauge Code": gg[0]["GaugeCode"],
            "Description": wmSpecs,
            #"Spec.": "\n".join(specOnly),
            "Spec.": wmSpecs,
            "Additional Spec.": addSpec,
            "calcVal": calcSum,
            "UoM": gg[0]["UoM"]
            }
        res.append(dict_res)
    
    
    return res

#extDicts = extractCalcResult(elemDicts)


# Assign your output to the OUT variable.
OUT = make_dict_groupBy_WM(elemDicts, specKeys)
#OUT = extractCalcResult(elemDicts, specKeys)
# ----------------------------------------
data_formatting_for_excel_export = Python(IN[0]=code_block_33.out1, IN[1]=wm별_계산결과_및_spec_정리_from_element)  # CPython3
# ---------- data_formatting_for_excel_export.python (80 lines) ----------
# Load the Python Standard and DesignScript Libraries
import sys
import clr
clr.AddReference('ProtoGeometry')
from Autodesk.DesignScript.Geometry import *

from itertools import groupby
from itertools import chain

# The inputs to this node will be stored as a list in the IN variables.
dataEnteringNode = IN

IsNewSheet = IN[0][0]
inputDatas = IN[0][1]
wmsDicts = list(filter(lambda x: x["calcVal"]!="" ,IN[1]))
# Place your code below this line

def get_wmsGrped_sorted_idxed(rangeDicts, wmsDicts):
    wmsSorted = sorted(wmsDicts, key=lambda x: x["Work Master Code"])
    wmsGrped = groupby(wmsDicts, lambda x: x["catStr"])
    wmsGrped_sorted = []
    
    for k,v in wmsGrped:
        grp_sorted = sorted(list(v), key=lambda x: x["Work Master Code"])
        stt_idx = rangeDicts[k][0]
        length_grp = len(grp_sorted)
        idxs = range(stt_idx, stt_idx+length_grp)
        zip_grp_idxs = list(zip(idxs, grp_sorted))
        for i in zip_grp_idxs:
            d = i[1]
            d["rIDX"] = i[0]
        
        wmsGrped_sorted.append(grp_sorted)
        
    wmsGrped_sorted_idxed = list(chain(*wmsGrped_sorted))
    return wmsGrped_sorted_idxed

def get_wmsGrped_sorted_idxed_(rangeDicts, wmsDicts):
    wmsSorted = sorted(wmsDicts, key=lambda x: x["Work Master Code"])
    wmsGrped = groupby(wmsDicts, lambda x: x["catStr"])
    wmsGrped_sorted = []
    
    for k,v in wmsGrped:
        grp_sorted = sorted(list(v), key=lambda x: x["Work Master Code"])
        
        stt_idx = rangeDicts#[k][0]
#        length_grp = len(grp_sorted)
#        idxs = range(stt_idx, stt_idx+length_grp)
#        zip_grp_idxs = list(zip(idxs, grp_sorted))
#        for i in zip_grp_idxs:
#            d = i[1]
#            d["rIDX"] = i[0]
#        
        #wmsGrped_sorted.append(grp_sorted)
        wmsGrped_sorted.append(stt_idx)
#        
    wmsGrped_sorted_idxed = list(chain(*wmsGrped_sorted))
    return wmsGrped_sorted_idxed

def match_DictWithIdx(datasOnWMCodeCol, wmsDicts):
    new_wmsDicts = []
    idxWithDatasOnWMCode = enumerate(datasOnWMCodeCol)
    for d in wmsDicts:
        if d["Work Master Code"] in datasOnWMCodeCol:
            d["rIDX"] = datasOnWMCodeCol.index(d["Work Master Code"])
            new_wmsDicts.append(d)
        else:
            pass
    #res = new_wmsDicts
    return new_wmsDicts

# Assign your output to the OUT variable.
if IsNewSheet:
    rangeDicts = inputDatas
    res = get_wmsGrped_sorted_idxed(rangeDicts, wmsDicts)
else:
    datasOnWMCodeCol = inputDatas
    res = filter(lambda x: x["calcVal"] != "", match_DictWithIdx(datasOnWMCodeCol, wmsDicts))

OUT = res
# ----------------------------------------
export_to_total_boq = Python(IN[0]=total_boq복사_및_경로_반환, IN[1]=code_block_31.sheetName, IN[2]=code_block_33.out0, IN[3]=code_block_33.out1, IN[4]=data_formatting_for_excel_export)  # CPython3; graph output
# ---------- export_to_total_boq.python (111 lines) ----------
# Load the Python Standard and DesignScript Libraries
import sys
import clr
clr.AddReference('ProtoGeometry')
from Autodesk.DesignScript.Geometry import *

from itertools import groupby

import DSOffice

# The inputs to this node will be stored as a list in the IN variables.
dataEnteringNode = IN
filePath = IN[0]
sheetName = IN[1]
hdrs_withIdx = IN[2]
IsNewSheet = IN[3][0]
dictList = IN[4]

# Place your code below this line
exportToExcel = DSOffice.Data.ExportToExcel
#print(hdrs_withIdx)

hdrsColIdxs = [
        hdrs_withIdx["Work Master Code"],
        hdrs_withIdx["Gauge Code"],
        hdrs_withIdx["Description"],
        hdrs_withIdx["Spec."],
        hdrs_withIdx["Additional Spec."],
        hdrs_withIdx["Reference to"],
        hdrs_withIdx["UoM"],
        hdrs_withIdx["targetBD"],
            ]

def writeToNewSheet(dictList):
    dictList_grped = groupby(dictList, lambda x: x["catStr"])
    
    dictList_grpedList = []
    for k,grp in dictList_grped:
        dictList_grpedList.append(list(grp))
    
    def writeExcel(keys, startColhdr, grpedList):
        for i in dictList_grpedList:
            #keys = ["Work Master Code", "Gauge Code", "Description", "Spec.", "Additional Spec.", ]
            startCol = hdrs_withIdx[startColhdr]
            startRow = i[0]["rIDX"]
    
            datas = list(zip(*map(lambda y: map(lambda x: x.get(y), list(i)), keys)))
            #res.append(datas)
            exportToExcel(filePath, sheetName, startRow, startCol, datas)
    
    #keys1 = ["Work Master Code", "Gauge Code", "Description", "Spec.", "Additional Spec.", ]
    keys1 = ["Work Master Code", "Gauge Code", "Description", "Spec.", "Additional Spec.", "Reference to", "UoM"]
    #keys2 = ["UoM"]
    keys3 = ["calcVal"]
    
    writeExcel(keys1,"Work Master Code", dictList_grpedList)
    #writeExcel(keys2,"UoM", dictList_grpedList)
    writeExcel(keys3,"targetBD", dictList_grpedList)
    
    return dictList_grpedList
    
def writeToExistSheet(dictList):
    dictList_grped = groupby(dictList, lambda x: x["catStr"])
    
    dictList_grpedList = []
    for k,grp in dictList_grped:
        dictList_grpedList.append(list(grp))
    
    def writeExcel_(keys,startColhdr, grpedList):
        #res = []
        for i in dictList_grpedList:
            #keys = ["Work Master Code", "Gauge Code", "Description", "Spec.", "Additional Spec.", ]
            startCol = hdrs_withIdx[startColhdr]
            startRow = i[0]["rIDX"]
    
            datas = list(zip(*map(lambda y: map(lambda x: x[y], list(i)), keys)))
            #res.append(datas)
            exportToExcel(filePath, sheetName, startRow, startCol, datas)
        #return res
        
    def writeExcel(key,startColhdr, dictList):
        all_rIDXs = list(map(lambda x: x["rIDX"], dictList))
        min_rIDX = min(all_rIDXs)
        max_rIDX = max(all_rIDXs)
        all_ranges = range(min_rIDX, max_rIDX+1)
        
        startCol = hdrs_withIdx[startColhdr]
        startRow = min_rIDX
        datas = []
        for i in all_ranges:
            if i in all_rIDXs:
                datas.append([dictList[all_rIDXs.index(i)][key]])
            else:
                datas.append([""])
        
        exportToExcel(filePath, sheetName, startRow, startCol, datas)
        
        #return datas
        
    key = "calcVal"
    
        
    writeExcel(key,"targetBD", dictList)
    
    return dictList_grpedList
# Assign your output to the OUT variable.

if IsNewSheet:
    OUT = writeToNewSheet(dictList)
else:
    OUT = writeToExistSheet(dictList)
# ----------------------------------------
code_block_35 = CodeBlock(famTypeDic=code_block_27) { famTypeDic; }
code_block_36 = CodeBlock(wmSpecs_headers=code_block_29) { wmSpecs_headers; }
wm별_spec_정리_from_family_list = Python(IN[0]=wm별_계산결과_및_spec_정리_from_element, IN[1]=code_block_35, IN[2]=code_block_36)  # CPython3; frozen
# ---------- wm별_spec_정리_from_family_list.python (150 lines) ----------
# Load the Python Standard and DesignScript Libraries
import sys
import clr
clr.AddReference('ProtoGeometry')
from Autodesk.DesignScript.Geometry import *

import operator
from itertools import groupby
from itertools import chain
import copy

# The inputs to this node will be stored as a list in the IN variables.
dataEnteringNode = IN
elemDicts = IN[0]
famTypeDict = IN[1]
wmSpecs_headers = IN[2]
wmDicts = list(famTypeDict.values())
#wmDicts = list(chain(*famTypeDict.values()))
# Place your code below this line
def merge_dicts(*dict_args):
    """
    Given any number of dictionaries, shallow copy and merge into a new dict,
    precedence goes to key-value pairs in latter dictionaries.
    """
    result = {}
    for dictionary in dict_args:
        result.update(dictionary)
    return result

def getUnique_wmDicts(wmDicts):
    headers = wmDicts[0].Keys
    #headers = wmDicts[0].keys()
    wmspec_headers = list(filter(lambda x: "Work C" in x or "Spec" in x, headers))
    noNeedKeys = ["Family Type Name", "Quantity", "rIDX", "Dynamo 물량산출식", "SheetName", "Q'ty Cal Type Tag"]
    def refineDicts(dicts, noNeedKeys):
        dicts_refined = []
        for d in dicts:
            new_d = {}
            keys,vals = d.Keys,d.Values
            keys_new = set(keys) - set(wmspec_headers)
            items = zip(keys, vals)  
            for k,v in items:
                if k not in noNeedKeys+wmspec_headers:
                    new_d[k] = v
                    #new_d["wmSpecs"] = ""
                    new_d["wmSpecs"] = list(map(lambda x: d[x], wmspec_headers))
            dicts_refined.append(new_d)
        return dicts_refined
    #wmDicts_refined = refineDicts(wmDicts, noNeedKeys)
        
    #allWMcodes = list(map(lambda x: x["Work Master Code"], wmDicts_refined))
    allWMcodes = list(map(lambda x: map(lambda y: y["Work Master Code"], x["wmSpecs"]), wmDicts))
    uniqueWMcodes = set(allWMcodes)
    
    def getUnique(dicts, tgt_key):##
        res = []
        tmp = []
        for d in dicts:
            for wm in d["wmSpecs"]:
                if wm[tgt_key] not in tmp:
                    tmp.append(wm[tgt_key])
                    res.append(wm)
        return res
    
    unique_wmDicts = getUnique(wmDicts, "Work Master Code")

        
    return unique_wmDicts
    

    
def reformatDicts(wmDicts, wmSpecs_headers):
    res = []
    
    for wm in wmDicts:
        keys = ["Work Master Code", "GaugeCode"]#, "wmSpecs"]
        vals = list(map(lambda x: wm[x],keys))
        items = list(zip(keys, vals))
        res_d = dict(items)
        
        #res_d["wmSpecs"] = list(map(lambda x: wm[x], wmSpecs_headers[:-2]))
        res_d["wmSpecs"] = list(filter(lambda x: x!=0 or x!="",map(lambda x: wm[x], wmSpecs_headers[:-2])))
        
        if "Description" in wm.Keys:
            res_d["Description"] = wm["Description"]
        else:
            res_d["Description"] = ""
        res_d["wmcANDgauge"] = "".join([str(wm["Work Master Code"]),str(wm["GaugeCode"])])
        res_d["UoM"] = wm["Unit"]
        res.append(res_d)
        
    return res

def make_dict_groupBy_WM(wmDicts, elemDicts):
    unique_wmDicts = getUnique_wmDicts(wmDicts)
    reformated_dicts = reformatDicts(unique_wmDicts, wmSpecs_headers)
    sortedDicts_WMC = sorted(reformated_dicts, key=operator.itemgetter("wmcANDgauge"))
    grpDicts_WMC = groupby(sortedDicts_WMC, key=operator.itemgetter("wmcANDgauge"))
    
    wm_valDicts = {}
    for x in elemDicts:
        wm_valDicts[x["Work Master Code"]] = x["calcVal"]
    
    
    res = []
    for k, g in grpDicts_WMC: 
        wmCode = k
        gg = copy.deepcopy(list(g))
        wmSpecs = gg[0]["wmSpecs"]
        catStr = "_".join([wmSpecs[0],wmSpecs[1]])
        #catStr = gg[0]["catStr"]
        #specOnly = list(filter(lambda x: x!=0 or x!="", wmSpecs))[3:]
        specOnly = list(filter(lambda x: x!=0 and x!="", wmSpecs))[3:]
        addSpec = gg[0]["Description"]
        if wm_valDicts.get(k):
            dict_res = {
                "catStr": catStr,
                "Work Master Code": wmCode,
                "Gauge Code": gg[0]["GaugeCode"],
                "Description": wmSpecs[2],
                "Spec.": "\n".join(specOnly),
                "Additional Spec.": addSpec,
                "calcVal": wm_valDicts[k],
                "UoM": gg[0]["UoM"]
                #"wmSpecs": wmSpecs,
                }
        else:
            dict_res = {
                "catStr": catStr,
                "Work Master Code": wmCode,
                "Gauge Code": gg[0]["GaugeCode"],
                "Description": wmSpecs[2],
                "Spec.": "\n".join(specOnly),
                "Additional Spec.": addSpec,
                "calcVal": "",
                "UoM": gg[0]["UoM"]
                #"wmSpecs": wmSpecs,
                }
        res.append(dict_res)
#        res.append(wmSpecs)
    
    
    return res

#unique_wmDicts = getUnique_wmDicts(wmDicts)
#reformated_dicts = reformatDicts(unique_wmDicts)

# Assign your output to the OUT variable.
#OUT = make_dict_groupBy_WM(wmsList)
OUT = make_dict_groupBy_WM(wmDicts, elemDicts)
# ----------------------------------------
code_block_37 = CodeBlock { "Steam Turbine Building"; "Gate House"; }
code_block_38 = CodeBlock(i=code_block_31.filePath) { i; }

n2_물량산출모드_입찰_실행 = CustomSelection("입찰", items={입찰: "입찰", 실행: "실행"})  # "2. 물량산출모드(입찰 / 실행)"; graph input
lang_mode_영_한_select = BoolSelector(true)

# group: Pjt Information Extract
categories_6 = Categories("OST_ProjectInformation")
all_elements_of_category_6 = ElementsOfCategory(Category=categories_6)
firstItem = List.FirstItem(list=all_elements_of_category_6)
code_block_39 = CodeBlock()
# ---------- code_block_39.designscript (4 lines) ----------
[
"Project Name",
"Building Name"
];
# ----------------------------------------
parameterByName = Parameter.ParameterByName(element=firstItem, name=code_block_39)
value = Parameter.Value(parameter=parameterByName)
parameters = Element.Parameters(element=firstItem)
hasValue = Parameter.HasValue(parameter=parameters)
filterByBoolMask_3 = List.FilterByBoolMask(list=parameters, mask=hasValue)
name = Parameter.Name(parameter=filterByBoolMask_3.in)
code_block_40 = CodeBlock(i=name) { i!="Category"; }
filterByBoolMask_4 = List.FilterByBoolMask(list=filterByBoolMask_3.in, mask=code_block_40)
value_2 = Parameter.Value(parameter=filterByBoolMask_4.in)
code_block_41 = CodeBlock(i=value_2) { i!=""; }
filterByBoolMask_5 = List.FilterByBoolMask(list=filterByBoolMask_4.in, mask=code_block_41)
name_2 = Parameter.Name(parameter=filterByBoolMask_5.in)
value_3 = Parameter.Value(parameter=filterByBoolMask_5.in)
byKeysValues = DesignScript.Builtin.Dictionary.ByKeysValues(keys=name_2, values=value_3)
stringifyJSON = Data.StringifyJSON(values=byKeysValues)
list_create_9 = List.Create(item0=name_2, item1=value_3)

building_name = CodeBlock(bdName=value) { bdName; }

# group: HTML 부재별 물량 기입을 위한 데이터 포맷팅 구간
code_block_42 = CodeBlock()
# ---------- code_block_42.designscript (10 lines) ----------
[
"Work Master Code /w Description",
"IfcGUID / GaugeCode",
"Description",
"산출 수식",
"값 대입 수식",
"Quantity",
"Unit",
"rIDX"
];
# ----------------------------------------
code_block_43 = CodeBlock(finRes=insert_wmGrp_toTypeDict) { finRes; }
code_block_44 = CodeBlock { "GUID"; }
valueAtKey = DesignScript.Builtin.Dictionary.ValueAtKey(dictionary=code_block_43, key=code_block_44)
code_block_45 = CodeBlock(i=code_block_43) { i["type_name"]; }
list_create_10 = List.Create()  # unwired: item0
map = List.Map(list=code_block_45, function=list_create_10)
addItemToEnd = List.AddItemToEnd(item=valueAtKey@L1, list=map@L2)
code_block_46 = CodeBlock { "WM No."; "Work Master"; "GaugeCode"; }
code_block_47 = CodeBlock(i=code_block_43, a=code_block_46.out1, b=code_block_46.out2)
# ---------- code_block_47.designscript (10 lines) ----------
[
i["wm_list"][a],
i["wm_list"][b],
i["wm_list"]["Spec."],
i["wm_list"]["적용 산출식"],
i["wm_list"]["대입 산출식"],
i["wm_list"]["계산 결과"],
i["wm_list"]["Unit"],
i["wm_list"]["rIDX"]
];
# ----------------------------------------
transpose_2 = List.Transpose(lists=code_block_47@@L4)
transpose_3 = List.Transpose(lists=transpose_2@@L3)
code_block_48 = CodeBlock(i=transpose_3) { i[0]; }
addItemToFront = List.AddItemToFront(item=addItemToEnd@L2, list=code_block_48@@L3, lacing=Shortest)
BOQbyElement_HTML_part = Python(IN[0]=code_block_42, IN[1]=addItemToFront)  # CPython3
# ---------- BOQbyElement_HTML_part.python (100 lines) ----------
# Load the Python Standard and DesignScript Libraries
import sys
import clr
clr.AddReference('ProtoGeometry')
from Autodesk.DesignScript.Geometry import *

clr.AddReference('RevitNodes')
import Revit
clr.ImportExtensions(Revit.Elements)
from Revit import Elements

################Module For Functional Programing#########################
from functools import reduce
from itertools import chain
from itertools import groupby
from copy import deepcopy
curry = lambda f: lambda a,*args: f(a, *args) if (len(args)) else lambda *args: f(a, *args)

filter,map,reduce = curry(filter),curry(map),curry(reduce)

go = lambda *args: reduce(lambda a,f: f(a), args) ## 함수도 축약 가능 ##

def dictUpdate(dic1,dic2):
    dic1.update(dic2)
    return dic1
    
def dictsMerge(dics):
    res = reduce(dictUpdate, dics)
    return res
    
def dictDeleteKeys(dic, keys):
    for k in keys:
        del dic[k]
    return dic

def flat(a):
    if isinstance(a, list):
        for i in a: 
            yield from flat(i)
    else: yield a
      
def grpBy(iter, key):
    f,grpKeys,grps = key,[],[]
    sorted_ = sorted(iter, key=f)
    for key, grp_data in groupby(sorted_,key=f):
        grpKeys.append(key); grps.append(list(grp_data))
    return grps,grpKeys
#########################################################################
# The inputs to this node will be stored as a list in the IN variables.
dataEnteringNode = IN
hdrs = IN[0]
grps = IN[1]
# Place your code below this line
def make_th(row):
    preStr = "<tr>"
    postStr = "</tr>"
    rowStrs = list(map(lambda x: f"<th>{x}</th>", row))
    res = "\n".join([preStr]+rowStrs+[postStr])
    return res

def make_tr(row):
    preStr = "<tr>"
    postStr = "</tr>"
    rowStrs = list(map(lambda x: f"<td>{x}</td>", row))
    res = "\n".join([preStr]+rowStrs+[postStr])
    return res

def make_trs(rows):
    rowsStrs = list(map(make_tr, rows))
    res = "\n".join(rowsStrs)
    return res

def make_trs_hd(rows):
    rowsStrs = list(map(make_th, rows))
    res = "\n".join(rowsStrs)
    return res

def make_wholeTable(rows):
    preStr = "<table>"
    postStr = "</table>"
    trs = make_trs(rows)
    res = "\n".join([preStr, trs, postStr])
    return res

def transTo_tableForm(grp):
    chkbox_tagStr = '<input type="checkbox" id="chkbox" name="checks">'

    #title = "<h5>"+grp.pop(0)+"</h5>"
    title = list(map(lambda x: "<h5>"+x+"</h5>" ,grp.pop(0)))
    #res = [title]
    res = title
    res.append(make_trs(grp))
    
    return res
    
rows = [[make_th(hdrs)]] + list(map(transTo_tableForm, grps))


# Assign your output to the OUT variable.
OUT = make_wholeTable(rows)
# ----------------------------------------
watch = Watch(addItemToFront)  # graph output

# group: HTML 부재별 물량 기입 구간
javascriptPart = Python()  # CPython3; unwired: IN[0], IN[1], IN[2]
# ---------- javascriptPart.python (59 lines) ----------
# Load the Python Standard and DesignScript Libraries
import sys
import clr
clr.AddReference('ProtoGeometry')
from Autodesk.DesignScript.Geometry import *

# The inputs to this node will be stored as a list in the IN variables.
dataEnteringNode = IN

# Place your code below this line
jsPart = '''
function hideAllPages() {
        document.querySelector("#home").style.fontWeight = "normal";
        document.querySelector("#homePage").style.display = "None";
        document.querySelector("#info").style.fontWeight = "normal";
        document.querySelector("#infoPage").style.display = "None";
        document.querySelector("#famType").style.fontWeight = "normal";
        document.querySelector("#famTypePage").style.display = "None";
        document.querySelector("#roomInfo").style.fontWeight = "normal";
        document.querySelector("#roomInfoPage").style.display = "None";
        document.querySelector("#roomInfoPage_chk").style.display = "None";
}

document.querySelector("#cat").onclick = function() {
	    let img = document.createElement("img");
	    img.setAttribute("src", "https://t4.ftcdn.net/jpg/05/62/99/31/360_F_562993122_e7pGkeY8yMfXJcRmclsoIjtOoVDDgIlh.jpg");
	    document.querySelector("#cat").style.display = "None";
	    img.setAttribute("style", "width:300px;margin-top:20px;")
	    document.body.append(img);
	};
document.querySelector("#home").onclick = function() {
        hideAllPages();
        document.querySelector("#home").style.fontWeight = "bolder";
        document.querySelector("#homePage").style.display = "inline";
	};
document.querySelector("#info").onclick = function() {
        hideAllPages();
        document.querySelector("#info").style.fontWeight = "bolder";
        document.querySelector("#infoPage").style.display = "inline";
	};
document.querySelector("#famType").onclick = function() {
        hideAllPages();
        document.querySelector("#famType").style.fontWeight = "bolder";
        document.querySelector("#famTypePage").style.display = "inline";
	};
document.querySelector("#roomInfo").onclick = function() {
        hideAllPages();
        document.querySelector("#roomInfo").style.fontWeight = "bolder";
        document.querySelector("#roomInfoPage").style.display = "inline";
	};
document.querySelector("#roomInfo_chk").onclick = function() {
        hideAllPages();
        document.querySelector("#roomInfo_chk").style.fontWeight = "bolder";
        document.querySelector("#roomInfoPage_chk").style.display = "inline";
	};
	
'''
# Assign your output to the OUT variable.
OUT = jsPart
# ----------------------------------------
cssPart = Python()  # CPython3; unwired: IN[0], IN[1], IN[2]
# ---------- cssPart.python (125 lines) ----------
# Load the Python Standard and DesignScript Libraries
import sys
import clr
clr.AddReference('ProtoGeometry')
from Autodesk.DesignScript.Geometry import *

# The inputs to this node will be stored as a list in the IN variables.
dataEnteringNode = IN

# Place your code below this line
cssPart = '''

/* style.css */
img {
 width : 25%;
 height: 25%; 
}

:root {
  --text-color: #f0f4f5;
  --background-color: #263343;
  --accent-color: orange;
  --icons-color: rgb(152, 187, 201);
  --bodybackground-color: lightgray;
}

th {
  text-align: center;
  padding-left: 30px;
}

td {
  padding-left: 40px;
  border-bottom : 1px solid gray;
  border-collapse : collapse;
}

body {
  margin: 0;
  background-color: var(--bodybackground-color);
  font-family: 'STIX Two Math';
} 

a {
  text-decoration: none;
  color: var(--text-color);
}

.navbar {
  display: flex;
  position: sticky;
  top: 0px; /* 도달했을때 고정시킬 위치 */
  justify-content: space-between;
  align-items: center;
  background-color: var(--background-color);
  padding: 8px 12px;
  font-family: 'STIX Two Math';
}

.navbar__logo i {
  color: var(--accent-color);
  padding-left: 0;
}

.navbar__menu {
  list-style: none;
  display: flex;
  margin: 0;
  padding-left: 0;
}

.navbar__menu li {
  padding: 8px 30px;
  color: var(--text-color);
}

.navbar__menu li:hover {
  background-color: var(--accent-color);
  border-radius: 3px;
}

.navbar__icons {
  list-style: none;
  display: flex;
  color: var(--icons-color);
  margin: 0;
  padding-left: 0;
}

.navbar__icons li {
  padding: 8px 12px;
  margin: 0;
}

#cat {
  display: block;
  }

#home {
  font-weight: bolder;
  }

#homePage {
  display: inline;
  }

#infoPage {
  display: None;
  }

#famTypePage {
  display: None;
  }

#roomInfoPage {
  display: None;
  }

#roomInfoPage_chk {
  display: None;
  }

'''
# Assign your output to the OUT variable.
OUT = cssPart
# ----------------------------------------
navHTML_Part = Python()  # CPython3; unwired: IN[0]
# ---------- navHTML_Part.python (24 lines) ----------
# Load the Python Standard and DesignScript Libraries
import sys
import clr
clr.AddReference('ProtoGeometry')
from Autodesk.DesignScript.Geometry import *

# The inputs to this node will be stored as a list in the IN variables.
dataEnteringNode = IN

# Place your code below this line
navPart = f"""

<nav class="navbar">

  <ul class="navbar__menu">
    <li id="home">Home</li>
  </ul>

</nav>

"""

# Assign your output to the OUT variable.
OUT = navPart
# ----------------------------------------
list_create_11 = List.Create(item0=BOQbyElement_HTML_part)
make_htmlStr = Python(IN[0]=javascriptPart, IN[1]=cssPart, IN[2]=navHTML_Part, IN[3]=building_name, IN[4]=list_create_11)  # CPython3
# ---------- make_htmlStr.python (59 lines) ----------
# Load the Python Standard and DesignScript Libraries
import sys
import clr
clr.AddReference('ProtoGeometry')
from Autodesk.DesignScript.Geometry import *

# The inputs to this node will be stored as a list in the IN variables.
dataEnteringNode = IN
jsPart = IN[0]
cssPart = IN[1]
navPart = IN[2]

pjtName = IN[3][0]
bdName = IN[3][1]
pages = IN[4]

homePage = pages[0]



# Place your code below this line
##folderPath_r = folderPath.replace('\\','\\\\')

htmlStr = f'''
<!DOCTYPE html>
<html lang="ko">

<head>
    <link rel="shortcut icon" href="#">
    <meta charset="UTF-8">
    <title>RVT Calculation Result</title>
    <style>
        {cssPart}
    </style>
</head>

<header>
<h5>Revit Elements' Bill of Quantities Page</h5>
<h4>{pjtName}</h4>
<h4>{bdName}</h4>
</header>

<body>
{navPart}

<div id="homePage">
{homePage}
</div>



<script type ="module" src="./js/script.js"></script>

</body>

</html>
'''
# Assign your output to the OUT variable.
OUT = htmlStr
# ----------------------------------------
code_block_49 = CodeBlock(htmlStr=make_htmlStr) { htmlStr; }
serverFilePath = CodeBlock { ".dynTemp"; }
htmlPath = Python(IN[0]=serverFilePath)  # CPython3
# ---------- htmlPath.python (35 lines) ----------
# Load the Python Standard and DesignScript Libraries
import sys
import clr
clr.AddReference('ProtoGeometry')
from Autodesk.DesignScript.Geometry import *
import time
import subprocess
import os

clr.AddReference('RevitNodes')
import Revit
clr.ImportExtensions(Revit.Elements)
from Revit import Elements
# The inputs to this node will be stored as a list in the IN variables.
dataEnteringNode = IN
dynTempServerPath = IN[0]
# Place your code below this line
def find_cwd():
    doc = Revit.Application.Document.Current
    filePath_string = doc.FilePath
    folderPath = filePath_string.split('\\')
    folderPath.pop(-1)
    folderPath_str = '\\'.join(folderPath)
    return folderPath_str

cwd = find_cwd()
#cwd = os.getenv("HomePath")

folderPath = f"{cwd}\\{dynTempServerPath}\\tmpForBOQ"
if not os.path.exists(folderPath):
    os.makedirs(folderPath)

# Assign your output to the OUT variable.
#OUT = "C:"+folderPath
OUT = folderPath
# ----------------------------------------
n0_set_port_number_기본값_8000_작동_오류 = StringInput("8000")  # "0. Set Port Number: 기본값-8000 (작동 오류 없다면 변경 금지)"; graph input
create_html_file_and_open = Python(IN[0]=code_block_49, IN[1]=htmlPath, IN[2]=n0_set_port_number_기본값_8000_작동_오류)  # CPython3
# ---------- create_html_file_and_open.python (85 lines) ----------
# Load the Python Standard and DesignScript Libraries
import os
import sys
import clr
clr.AddReference('ProtoGeometry')
from Autodesk.DesignScript.Geometry import *

clr.AddReference('RevitNodes')
import Revit
clr.ImportExtensions(Revit.Elements)
from Revit import Elements

import time
import subprocess
import asyncio
import multiprocessing

#################################Module For Functional Programing#############################################
from functools import reduce
curry = lambda f: lambda a,*args: f(a, *args) if (len(args)) else lambda *args: f(a, *args)

filter = curry(filter)
map = curry(map)

def _take(length, iter):
    res = []
    for a in iter:
        res.append(a)
        if len(res) == length:
            return res
        
take = curry(_take)
reduce = curry(reduce)

go = lambda *args: reduce(lambda a,f: f(a), args) ## 함수도 축약 가능 ##
##############################################################################################################

# The inputs to this node will be stored as a list in the IN variables.
dataEnteringNode = IN
contents = IN[0]
folderPath = IN[1]
cwd = folderPath
portNo = IN[2]
#bdName = IN[2]
# Place your code below this line

def find_cwd():
    doc = Revit.Application.Document.Current
    filePath_string = doc.FilePath
    folderPath = filePath_string.split('\\')
    folderPath.pop(-1)
    folderPath_str = '\\'.join(folderPath)
    return folderPath_str

def make_resultHTMLname(htmlStr,title,cwd):
    timeStamp = time.strftime('%H_%M_%S', time.localtime(time.time()))
    #folderPath = f"{cwd}\\.dynLog"
    folderPath = cwd
    if not os.path.exists(folderPath):
        os.makedirs(folderPath)
    fileName = f"index.html"
    filePath = f"{folderPath}\\" + fileName
    f = open(filePath, 'w', encoding='utf8')
    f.write(htmlStr)
    f.close()
    return fileName


def execute_browser(cwd):
    #cwd = find_cwd()
    folderPath = cwd
    os.chdir(folderPath)
    #cmdStr = "start chrome http:localhost:8000"
    cmdStr = f"start msedge http:localhost:{portNo}"
    cmdList= cmdStr.split(' ')
    #subprocess.run(args=[fileName], shell=True)
    #subprocess.run(args=['start','excel',fileName], shell=True)
    subprocess.run(args=cmdList, shell=True)
    return cmdList


fileName = make_resultHTMLname(contents,"test",cwd)

# Assign your output to the OUT variable.
OUT = execute_browser(cwd)#fileName.split('.')[0]
# ----------------------------------------
create_js_file = Python(IN[0]=javascriptPart, IN[1]=htmlPath)  # CPython3; unwired: IN[2]
# ---------- create_js_file.python (84 lines) ----------
# Load the Python Standard and DesignScript Libraries
import os
import sys
import clr
clr.AddReference('ProtoGeometry')
from Autodesk.DesignScript.Geometry import *

clr.AddReference('RevitNodes')
import Revit
clr.ImportExtensions(Revit.Elements)
from Revit import Elements

import time
import subprocess

#################################Module For Functional Programing#############################################
from functools import reduce
curry = lambda f: lambda a,*args: f(a, *args) if (len(args)) else lambda *args: f(a, *args)

filter = curry(filter)
map = curry(map)

def _take(length, iter):
    res = []
    for a in iter:
        res.append(a)
        if len(res) == length:
            return res
        
take = curry(_take)
reduce = curry(reduce)

go = lambda *args: reduce(lambda a,f: f(a), args) ## 함수도 축약 가능 ##
##############################################################################################################

# The inputs to this node will be stored as a list in the IN variables.
dataEnteringNode = IN
contents = IN[0]
folderPath = IN[1]
#bdName = IN[2]
# Place your code below this line
def find_cwd():
    doc = Revit.Application.Document.Current
    filePath_string = doc.FilePath
    folderPath = filePath_string.split('\\')
    folderPath.pop(-1)
    folderPath_str = '\\'.join(folderPath)
    return folderPath_str

#cwd = find_cwd()
cwd = folderPath

def make_resultHTMLname(jsStr,cwd):
    #timeStamp = time.strftime('%H_%M_%S', time.localtime(time.time()))
    #folderPath = f"{cwd}\\.dynLog"
    folderPath = cwd
    jsPath = cwd + "\\js"
    if not os.path.exists(folderPath):
        os.makedirs(folderPath)
    if not os.path.exists(jsPath):
        os.makedirs(jsPath)
    fileName = "script.js"
    filePath = f"{jsPath}\\" + fileName
    f = open(filePath, 'w', encoding='utf8')
    f.write(jsStr)
    f.close()
    return fileName

def execute_file(fileName):
    #cwd = find_cwd()
    folderPath = cwd
    os.chdir(folderPath)
    subprocess.run(args=[fileName], shell=True)
    #subprocess.run(args=['start','excel',fileName], shell=True)
    

fileName = make_resultHTMLname(contents,cwd)
#fileName = "Test1.html"

#execute_file(fileName)


# Assign your output to the OUT variable.
OUT = fileName
# ----------------------------------------
start_webserver = Python(IN[0]=htmlPath, IN[1]=n0_set_port_number_기본값_8000_작동_오류)  # CPython3
# ---------- start_webserver.python (48 lines) ----------
# Load the Python Standard and DesignScript Libraries
import sys
import clr
clr.AddReference('ProtoGeometry')
from Autodesk.DesignScript.Geometry import *

import os
import asyncio
import multiprocessing
import subprocess
# The inputs to this node will be stored as a list in the IN variables.
dataEnteringNode = IN
cwd = IN[0]
portNo = IN[1]
# Place your code below this line
batStr = f"""
@echo on
python -m http.server {portNo}
cmd /k
"""
##cmd /k
title = "localWebserver"

def make_startSever_bat(batStr,title,cwd):
    folderPath = cwd
    if not os.path.exists(folderPath):
        os.makedirs(folderPath)
    fileName = f"{title}.bat"
    filePath = f"{folderPath}\\" + fileName
    f = open(filePath, 'w', encoding='utf8')
    f.write(batStr)
    f.close()
    return fileName

def startBat(fileName, cwd):
    cmdStr = f".\\{fileName}"
    cmdList= cmdStr.split(' ')
    os.chdir(cwd)
    
    res = subprocess.Popen(args=cmdList, shell=True)
    return res

batFileName = make_startSever_bat(batStr,title,cwd)
#res = multiprocessing.Process(name="SubProcess", target=startBat, args=(batFileName, cwd))
# Assign your output to the OUT variable.
OUT = startBat(batFileName, cwd)

#startBat(fileName, cwd)
# ----------------------------------------
make_htmlStr_2 = Python(IN[0]=javascriptPart, IN[1]=cssPart)  # CPython3; unwired: IN[2]
# ---------- make_htmlStr_2.python (53 lines) ----------
# Load the Python Standard and DesignScript Libraries
import sys
import clr
clr.AddReference('ProtoGeometry')
from Autodesk.DesignScript.Geometry import *

# The inputs to this node will be stored as a list in the IN variables.
dataEnteringNode = IN
jsPart = IN[0]
cssPart = IN[1]
tablePart = IN[2]

# Place your code below this line
##folderPath_r = folderPath.replace('\\','\\\\')

htmlStr = f'''
<!DOCTYPE html>
<html lang="ko">

<head>
    <meta charset="UTF-8">
    <title>my first three.js app</title>
    <style>
        {cssPart}
    </style>
</head>

<body>


<div class="wrapper">

  <a data-fslightbox="gallery" href="#custom-source">
    유튜브 라이트박스
  </a>

  <iframe id="custom-source"
          frameborder="0"
          width="1920px"
          height="1080px"
          allow="autoplay; fullscreen"
          src="https://www.youtube.com/embed/qgBSiRwsbNw?autoplay=1">
  </iframe>
</div>

<script src="https://cdnjs.cloudflare.com/ajax/libs/fslightbox/3.3.1/index.min.js" integrity="sha512-EqNNJuepkw5P9vxCml8eBk7C4Ld+4kAnvzOD/jG21rkxWPILGoQa5EvD62UieiJF0u3xoQrcVnce4i83VnYj/Q==" crossorigin="anonymous" referrerpolicy="no-referrer"></script>

</body>

</html>
'''
# Assign your output to the OUT variable.
OUT = htmlStr
# ----------------------------------------

code_block_50 = CodeBlock { [""]; }
code_block_51 = CodeBlock(i=importExcel) { i[0]; }
count = List.Count(list=code_block_51)
sheet_rowRange = CodeBlock(i=count) { i; }
sheet_rowRange_2 = CodeBlock(i=sheet_rowRange) { i; }
sheet_rowRange_3 = CodeBlock(i=sheet_rowRange_2) { i; }
cycle = List.Cycle(list=code_block_50, amount=sheet_rowRange_3)
code_block_52 = CodeBlock(i=cycle) { [i]; }

# group: Family List 타입별 물량 기입을 위한 데이터 포맷팅 구간
code_block_53 = CodeBlock(res=code_block_20) { res; }
code_block_54 = CodeBlock(i=code_block_53) { i["wm_list"]; }
flatten_2 = List.Flatten(list=code_block_54)
code_block_55 = CodeBlock(i=flatten_2) { i["rIDX"]; }
groupByKey = List.GroupByKey(list=flatten_2@L2, keys=code_block_55@L2)
code_block_56 = CodeBlock(i=groupByKey.uniqueKeys) { i[0]; }
code_block_57 = CodeBlock(i=groupByKey.groups) { i["계산 결과"]; }
sum_without_err = Python(IN[0]=code_block_57)  # CPython3
# ---------- sum_without_err.python (23 lines) ----------
# Load the Python Standard and DesignScript Libraries
import sys
import clr
clr.AddReference('ProtoGeometry')
from Autodesk.DesignScript.Geometry import *

# The inputs to this node will be stored as a list in the IN variables.
dataEnteringNode = IN
cat_rIDX_vals = IN[0]
# Place your code below this line

res = []
for catGrp in cat_rIDX_vals:
    new_catGrp = []
    for i in catGrp:
        try:
            new_catGrp.append(sum(i))
        except:
            new_catGrp.append(0)
    res.append(new_catGrp)

# Assign your output to the OUT variable.
OUT = res
# ----------------------------------------
replace_forCalcultionExport = Python(IN[0]=code_block_56, IN[2]=sum_without_err, IN[3]=code_block_52)  # CPython3; frozen; unwired: IN[1]
# ---------- replace_forCalcultionExport.python (34 lines) ----------
# Load the Python Standard and DesignScript Libraries
import sys
import clr
clr.AddReference('ProtoGeometry')
from Autodesk.DesignScript.Geometry import *

# The inputs to this node will be stored as a list in the IN variables.
dataEnteringNode = IN
replaceSheetIdx = IN[0]
replace_idxsGrps = IN[1]
replace_valsGrps = IN[2]
src_list = IN[3]


# Place your code below this line
def replace_calcForExport(replace_idxsGrps, replace_valsGrps, src_list, replaceSheetIdx):
    zipped_cats = list(zip(replace_idxsGrps, replace_valsGrps))
    for x in range(len(zipped_cats)):
        grps_cat = zipped_cats[x]
        src_cat = src_list[replaceSheetIdx[x]]
        for i in range(len(grps_cat[0])):
            idx = grps_cat[0][i]
            print(idx)
            vals = grps_cat[1][i]
            src_cat[idx] = vals
    return src_list
        
if any(replaceSheetIdx):
    res = replace_calcForExport(replace_idxsGrps, replace_valsGrps, src_list, replaceSheetIdx)
else:
    res = src_list

# Assign your output to the OUT variable.
OUT = res
# ----------------------------------------
code_block_58 = CodeBlock()
# ---------- code_block_58.designscript (3 lines) ----------
[
"5.P Family"
];
# ----------------------------------------
code_block_59 = CodeBlock { 5; }

code_block_60 = CodeBlock()
# ---------- code_block_60.designscript (15 lines) ----------
["0.Room"
,"1.Floors"
,"2.Roofs"
,"3.Walls_Ext"
,"3.Walls_Int"
,"4.St_Fdn"
,"5.St_Col"
,"6.St_Framing"
,"7.Ceilings"
,"8.Doors"
,"9.Windows"
,"10.Stairs"
,"11.Railings"
,"12.Generic"
,"13.Manual_Input"];
# ----------------------------------------
code_block_61 = CodeBlock(i=importExcel) { i[0]; }
code_block_62 = CodeBlock()
# ---------- code_block_62.designscript (12 lines) ----------
[
"!!!",
"!!!",
"!!!",
"!!!",
"!!!",
"WWWW",
"WWWW",
"WWWW",
"WWWW",
"WWWW"
];
# ----------------------------------------
code_block_63 = CodeBlock(file_path=n1_family_list_경로_입력_2) { file_path; }
code_block_64 = CodeBlock(file_path=code_block_63) { file_path; }
시트별_quantity_열_인덱스 = CodeBlock { 14; }
code_block_65 = CodeBlock(i=sum_without_err) { i[0]; }
python_script = Python(IN[0]=code_block_56, IN[1]=code_block_65, IN[2]=cycle)  # CPython3
# ---------- python_script.python (23 lines) ----------
# Load the Python Standard and DesignScript Libraries
import sys
import clr
clr.AddReference('ProtoGeometry')
from Autodesk.DesignScript.Geometry import *

# The inputs to this node will be stored as a list in the IN variables.
dataEnteringNode = IN
replace_idx = IN[0]
replace_data = IN[1]
tgt_list = IN[2]


# Place your code below this line
def replace_list(replace_idx, replace_data, tgt_list):
    for idx,val in zip(replace_idx, replace_data):
        tgt_list[idx] = val
        
    return tgt_list


# Assign your output to the OUT variable.
OUT = replace_list(replace_idx, replace_data, tgt_list)
# ----------------------------------------

# group (continued): Family List 타입별 물량 기입을 위한 데이터 포맷팅 구간
dropItems_5 = List.DropItems(list=python_script@L2, amount=code_block_59)

# group: Family List 타입별 물량 기입 구간
code_block_66 = CodeBlock(file_path=code_block_64) { file_path; }
allSheetNames = CodeBlock(allSheetNames=code_block_58) { allSheetNames[0]; }
code_block_67 = CodeBlock { 5; [0]; }
code_block_68 = CodeBlock(data=dropItems_5) { data[0]; }
exportToExcel = Data.ExportToExcel(filePath=code_block_66, sheetName=allSheetNames, startRow=code_block_67.out0, startColumn=시트별_quantity_열_인덱스, data=code_block_68)

getItemAtIndex_5 = List.GetItemAtIndex(list=exportToExcel@L2, index=시트별_quantity_열_인덱스)
update_calcResult_typeDict______________ = Python(IN[0]=familylist_data_dictionarize_2, IN[1]=list_create_7)  # "update_calcResult_typeDict_________________________22_________"; CPython3; frozen
# ---------- update_calcResult_typeDict______________.python (141 lines) ----------
# Load the Python Standard and DesignScript Libraries
import sys
import clr
clr.AddReference('ProtoGeometry')
from Autodesk.DesignScript.Geometry import *
import re
import json
import ast

################Module For Functional Programing#########################
from functools import reduce
from itertools import chain
from itertools import groupby
from copy import deepcopy

curry = lambda f: lambda a, *args: (
    f(a, *args) if (len(args)) else lambda *args: f(a, *args)
)

filter, map, reduce = curry(filter), curry(map), curry(reduce)

go = lambda *args: reduce(lambda a, f: f(a), args)  ## 함수도 축약 가능 ##


def dictUpdate(dic1, dic2):
    dic1.update(dic2)
    return dic1


def dictsMerge(dics):
    res = reduce(dictUpdate, dics)
    return res


def dictDeleteKeys(dic, keys):
    for k in keys:
        del dic[k]
    return dic


def flat(a):
    if isinstance(a, list):
        for i in a:
            yield from flat(i)
    else:
        yield a


def grpBy(iter, key):
    f, grpKeys, grps = key, [], []
    sorted_ = sorted(iter, key=f)
    for key, grp_data in groupby(sorted_, key=f):
        grpKeys.append(key)
        grps.append(list(grp_data))
    return grps, grpKeys


#########################################################################
# The inputs to this node will be stored as a list in the IN variables.
dataEnteringNode = IN
#pjt_typeWM_match_dicts_str = IN[0]
#pjt_typeWM_match_dicts = json.loads(pjt_typeWM_match_dicts_str)
pjt_typeWM_match_dicts = IN[0]
allElems_name = IN[1][0]
allElems = IN[1][1]

# Place your code below this line

def get_param_value(elem, name):
    if name not in list(map(lambda x: x.Name, elem.Parameters)):
        calc_v = elem.ElementType.GetParameterValueByName(name)
    elif name == "H_Room H or CH":
        if elem.GetParameterValueByName(name)=="":
            calc_v = elem.GetParameterValueByName("Unbounded Height")
        else:
            calc_v = elem.GetParameterValueByName(name)
    else:
        calc_v = elem.GetParameterValueByName(name)
    
    if calc_v=="":
        calc_v = 0
    
    return round(calc_v,3)

def update_calcResult_typeDict(pjt_typeWM_match_dicts, allElems, allElems_name):
    res = []
    for idx, elem in enumerate(allElems):
        elem_famType_name = allElems_name[idx].upper()
        for typeDict in pjt_typeWM_match_dicts:
            typeDict["GUID"] = elem.GetParameterValueByName("IfcGUID")
            #print(elem.GetParameterValueByName("ifcGUID"))
            if typeDict["type_name"].strip() == elem_famType_name.strip():
                #param_names = sorted(typeDict["params"].keys(), key=len, reverse=True)
                param_names = sorted(typeDict["params"].Keys, key=len, reverse=True)
                param_values = list(map(lambda x: typeDict["params"][x], param_names))
                
                ###### 약자 값 업데이트 구간
                updated_param_values = []
                for param_v in param_values:
                    if not isinstance(param_v, float):
                        updated_param_values.append(get_param_value(elem, param_v))
                    else:
                        updated_param_values.append(param_v)
                typeDict["calc_params"] = dict(zip(param_names,updated_param_values))
                ####### 약자 값 업데이트 구간####
                
                for wm in typeDict["wm_list"]:
                    wm["GaugeCode"] = ""
                    wm["type_name"] = typeDict["type_name"]
                    if wm["변경 산출식"]:
                        formula = str(wm["변경 산출식"])
                    else:
                        formula = str(wm["표준 산출식"])
                    wm["적용 산출식"] = formula
                        
                    tmp_formula = formula
                    
                    if tmp_formula != "=Exca" and tmp_formula != "=Back" and tmp_formula != "=Disp":
                        for n,v in typeDict["calc_params"].items():
                            tmp_formula = tmp_formula.replace(n, str(v))
                        
                        wm["대입 산출식"] = tmp_formula
                        try:
                            wm["계산 결과"] = eval(tmp_formula.strip("="))
                        except:
                            wm["로그"] = "!! 오류 발생 !! 수식 약자 및 파라미터 연동 확인 필요 !!"
                            wm["계산 결과"] = 0
                    else:
                        wm["대입 산출식"] = ""
                        wm["계산 결과"] = ""
                        wm["로그"] = "토공"
                
                res.append(typeDict)
    return res
    # Convert nested dictionary to JSON string before returning
    #return json.dumps(res, ensure_ascii=False, indent=2)
    
res = update_calcResult_typeDict(pjt_typeWM_match_dicts, allElems, allElems_name)
print(res)
# Assign your output to the OUT variable.
OUT = res
# ----------------------------------------
file_from_path_3 = FileObject(path=n1_family_list_경로_입력_2)
readText = FileSystem.ReadText(file=file_from_path_3)
parseJSON = Data.ParseJSON(json=readText)
code_block_69 = CodeBlock(i=parseJSON) { i["project-assigntype"]["children"]; }
code_block_70 = CodeBlock(i=parseJSON) { i["std-calcdict"]["children"]; }
code_block_71 = CodeBlock(i=familylist_data_dictionarize) { i; }
code_block_72 = CodeBlock(file_path=n1_family_list_경로_입력_2) { file_path; }
code_block_73 = CodeBlock(file_path=code_block_72) { file_path; }
make_excel_path = Python(IN[0]=code_block_73)  # CPython3
# ---------- make_excel_path.python (76 lines) ----------
# Load the Python Standard and DesignScript Libraries
import sys
import clr
clr.AddReference('ProtoGeometry')
from Autodesk.DesignScript.Geometry import *
import datetime

################Module For Functional Programing#########################
from functools import reduce
from itertools import chain
from itertools import groupby
from copy import deepcopy

curry = lambda f: lambda a, *args: (
    f(a, *args) if (len(args)) else lambda *args: f(a, *args)
)

filter, map, reduce = curry(filter), curry(map), curry(reduce)

go = lambda *args: reduce(lambda a, f: f(a), args)  ## 함수도 축약 가능 ##


def dictUpdate(dic1, dic2):
    dic1.update(dic2)
    return dic1


def dictsMerge(dics):
    res = reduce(dictUpdate, dics)
    return res


def dictDeleteKeys(dic, keys):
    for k in keys:
        del dic[k]
    return dic


def flat(a):
    if isinstance(a, list):
        for i in a:
            yield from flat(i)
    else:
        yield a


def grpBy(iter, key):
    f, grpKeys, grps = key, [], []
    sorted_ = sorted(iter, key=f)
    for key, grp_data in groupby(sorted_, key=f):
        grpKeys.append(key)
        grps.append(list(grp_data))
    return grps, grpKeys


#########################################################################

# The inputs to this node will be stored as a list in the IN variables.
dataEnteringNode = IN
bnote_path = IN[0]
# Place your code below this line

def make_excel_path(bnote_path):
    seg = bnote_path.split("\\")
    bnote_name = seg[-1].split(".bnote")[0]
    now = datetime.datetime.now()
    stamp = now.strftime("%m%d-%I%M%S")
    excel_name = f"{bnote_name}_excel_qty_result_{stamp}"
    excel_path = "\\".join(seg[:-1]) +"\\"+ excel_name

    return excel_path



# Assign your output to the OUT variable.
OUT = make_excel_path(bnote_path)
# ----------------------------------------
code_block_74 = CodeBlock { "calc"; }
code_block_75 = CodeBlock { 0; }
building_name_2 = StringInput("Sample Building")  # graph input
code_block_76 = CodeBlock(building_name=building_name_2) { building_name; }
calculation = Python(IN[0]=code_block_76, IN[1]=parseJSON, IN[2]=list_create_7)  # CPython3; unwired: IN[3]
# ---------- calculation.python (271 lines) ----------
# Load the Python Standard and DesignScript Libraries
import sys
import clr
clr.AddReference('ProtoGeometry')
from Autodesk.DesignScript.Geometry import *


################Module For Functional Programing#########################
from functools import reduce
from itertools import chain
from itertools import groupby
from copy import deepcopy

curry = lambda f: lambda a, *args: (
    f(a, *args) if (len(args)) else lambda *args: f(a, *args)
)

filter, map, reduce = curry(filter), curry(map), curry(reduce)

go = lambda *args: reduce(lambda a, f: f(a), args)  ## 함수도 축약 가능 ##


def dictUpdate(dic1, dic2):
    dic1.update(dic2)
    return dic1


def dictsMerge(dics):
    res = reduce(dictUpdate, dics)
    return res


def dictDeleteKeys(dic, keys):
    for k in keys:
        del dic[k]
    return dic


def flat(a):
    if isinstance(a, list):
        for i in a:
            yield from flat(i)
    else:
        yield a


def grpBy(iter, key):
    f, grpKeys, grps = key, [], []
    sorted_ = sorted(iter, key=f)
    for key, grp_data in groupby(sorted_, key=f):
        grpKeys.append(key)
        grps.append(list(grp_data))
    return grps, grpKeys


#########################################################################

# The inputs to this node will be stored as a list in the IN variables.
dataEnteringNode = IN
building_name = IN[0]
bnote_data = IN[1]
all_elemNames, all_elems = IN[2]
bnote_path = IN[3]

# Place your code below this line

bnote_revitTypes_inBuilding = go(
    bnote_data["project-assigntype"]["children"],
    filter(lambda x: list(x["values"])[1]==building_name),
    list,
)

bnote_revitType_names_inBuilding = go(
    bnote_revitTypes_inBuilding,
    map(lambda x: x["name"]),
    list,
)

all_eff_elems = go(
    zip(all_elemNames, all_elems),
    filter(lambda x: x[0] in bnote_revitType_names_inBuilding),
    map(lambda x: \
        {
            "name": x[0],
            "elem": x[1],
        }
    ),
    list,
)

def get_param_value(elem, name):
    if name not in list(map(lambda x: x.Name, elem.Parameters)):
        calc_v = elem.ElementType.GetParameterValueByName(name)
    elif name == "H_Room H or CH":
        if elem.GetParameterValueByName(name)=="":
            calc_v = elem.GetParameterValueByName("Unbounded Height")
        else:
            calc_v = elem.GetParameterValueByName(name)
    else:
        calc_v = elem.GetParameterValueByName(name)
    
    if calc_v=="":
        calc_v = 0
    
    return round(calc_v,3)

def calc_elem(elem_dic):
    def check_Str(_str):
        try:
            float(_str)
            return False
        except:
            return True
    
    elem = elem_dic["elem"]
    elem_dic.update(
        {
            "GUID": elem.GetParameterValueByName("IfcGUID"),
        }
    )
    
    tgt_bnoteType = go(
        bnote_revitTypes_inBuilding,
        filter(lambda x: x["name"]==elem_dic["name"]),
        list,
    )[0]
    
    tgt_bnoteType_wmlist = go(
        list(list(tgt_bnoteType["children"])),
        #map( lambda x: [ list(x)[:5], list(x)[3].split(" | ")[0], list(x)[6:] ] ),
        list,
    )
    
    calcType_no = list(list(tgt_bnoteType["children"])[0])[-1]
    
    tgt_bnote_calcdict = go(
        bnote_data["std-calcdict"]["children"],
        filter( lambda x: x["name"]==calcType_no ),
        list,
    )[0]
    param_list = go(
        tgt_bnote_calcdict["children"],list,
        map(lambda x: x["values"]), list,
        map(lambda x: list(x)[1:]),
        lambda x: sorted(x, key=lambda x: len(str(x[0])), reverse=True),
        list,
    )
    calc_param_list = go(
        param_list,
        map( lambda x: [ x[0], get_param_value(elem, x[1])] if check_Str(x[1]) else [x[0], float(x[1]) ] ),
        list,
        lambda x: sorted(x, key=lambda x: len(str(x[0])), reverse=True),
    )
    
    def calc_formula(formula, calc_param_list):
        tmp_formula = formula
        if tmp_formula != "=Exca" and tmp_formula != "=Back" and tmp_formula != "=Disp":
            for n,v in calc_param_list:
                tmp_formula = tmp_formula.replace(n, str(v))
            try:
                calc_result = eval(tmp_formula.strip("=")), "계산 성공"
            except:
                calc_result = 0, "계산 실패 - 수식 혹은 파라미터가 유효하지 않음"
        else:
            tmp_formula = formula
            calc_result = 0, "토공 항목 - [H_PAB.RT.Q2A]_Revit 토공 물량 자동산출.dyn에서 산출 요망"
        
        #return formula, tmp_formula, *calc_result
        
        return {
            "수식": "'"+formula,
            "대입수식": "'"+tmp_formula,
            "산출결과": calc_result[0],
            "산출로그": calc_result[1],
        }
    wm_dict_hdrs = [
        "분류", "표준타입", "세분류", "wm", "gauge",
        "add_spec", "수식", "단위", "산출유형",
        ]
    wm_dicts = go(
        tgt_bnoteType_wmlist,
        map( lambda x: dict(zip(wm_dict_hdrs, x)) ),
        list,
    )
    
    
    tgt_bnoteType_wm_calcvalue = []
    for wm_dict in wm_dicts:
        wm_dict.update(
            calc_formula(wm_dict["수식"], calc_param_list)
        )
        wm_code = wm_dict["wm"].split("|")[0].strip()
        
        try:
            wm_desc = wm_dict["wm"].split(" | ")[7]
        except:
            wm_desc = ""
            
        wm_spec = go(
            wm_dict["wm"].split(" | ")[9:-4],
            filter( lambda x: not x.isnumeric() ),
            filter(lambda x: not ( ("(   )" in x) or ("(   )" in x) or ("(  )" in x)) ),
            lambda x: "\n".join(x),
        )
        
        wm_dict.update(
            {
                "wm_code": wm_code,
                "wm_desc": wm_desc,
                "wm_spec": wm_spec,
            }
        )
        tgt_bnoteType_wm_calcvalue.append(wm_dict)
    
    
    elem_dic.update(
        {
            "물량": tgt_bnoteType_wm_calcvalue,
        }
    )
    
    #return tgt_bnoteType_wm_calcvalue
    #return tgt_bnoteType_wmlist
    return elem_dic


# Flatten the nested structure into a list of rows
def flatten_data(data):
    flat_data = []
    for dic in data:
        elem_name = dic["name"]
        elem = dic["elem"]
        guid = dic["GUID"]
        for item in dic["물량"]:
            flat_data.append(
                [
                    elem_name,
                    guid,       # GUID
                    item["분류"],
                    item["표준타입"],
                    item["세분류"],
                    item["wm_code"],
                    item["gauge"],
                    item["wm_desc"],
                    item["wm_spec"],
                    item["add_spec"],
                    item["수식"],
                    item["대입수식"],
                    item["산출결과"],
                    item["단위"],
                    item["산출유형"],
                    item["산출로그"],
                ]
            )
    return flat_data

data = map(calc_elem, all_eff_elems)

flat_header = [
    "name", "GUID", "분류", "표준타입", "세분류", "wm_code", "gauge", "Description", "Spec.", 
    "Add_spec.", "수식", "대입수식", "산출결과", "단위", "산출유형", "산출로그",
    ]

flat_data = [flat_header]+flatten_data(data)


# Assign your output to the OUT variable.
#OUT = calc_elem(all_eff_elems[195])

OUT = flat_data
#OUT = all_eff_elems[29]
# ----------------------------------------
exportToExcel_2 = Data.ExportToExcel(filePath=make_excel_path, sheetName=code_block_74, startRow=code_block_75, startColumn=code_block_75, data=calculation)
watch_2 = Watch(calculation)
