# Dynamo graph [H_PAB.RT.Q2]_Revit 물량 산출_[3.2.11].dyn "[H_PAB.RT.Q2]_Revit 물량 산출_[3.2.10]_rev" (Dynamo 3.3.0.6316)
# author: MK Jang
# Auto Calculating the Quantities of each Element As per the Family List

# group: All Data In B-note
n1_family_list_경로_입력 = Filename("..\H_BimNote\fl_lat.xlsx")  # "1. Family List 경로 입력"; frozen
n2_b_note_파일_경로_입력 = Filename("..\4_codetest\250724_물량산출code\testmodel_door\2025 DQRU 입찰 (Rev.AB)_20250919_mk.bnote")  # "▶ 2. B-note 파일 경로 입력 >>"; graph input

n1_building_name_b_note_상의_이름과 = StringInput("SULPHUR PACKAGE BUILDING")  # "▶ 1. Building Name (B-note 상의 이름과 동일해야 합니다.) >>"; graph input
code_block = CodeBlock(building_name=n1_building_name_b_note_상의_이름과) { building_name; }
code_block_2 = CodeBlock(file_path=n2_b_note_파일_경로_입력) { file_path; }
code_block_3 = CodeBlock(file_path=code_block_2) { file_path; }

# group: All Elements in Revit
categories = Categories("OST_Rooms")
all_elements_of_category = ElementsOfCategory(Category=categories)
list_create = List.Create(item0=all_elements_of_category)
categories_2 = Categories("OST_Gutter")
all_elements_of_category_2 = ElementsOfCategory(Category=categories_2)
list_create_2 = List.Create(item0=all_elements_of_category_2)
all_elementsexceptrails = Python()  # CPython3; unwired: IN[0]
# ---------- all_elementsexceptrails.python (51 lines) ----------
# Load the Python Standard and DesignScript Libraries
import sys
import clr
clr.AddReference('ProtoGeometry')
from Autodesk.DesignScript.Geometry import *

clr.AddReference('RevitAPI')
from Autodesk.Revit.DB import *
import Autodesk

clr.AddReference('RevitServices')
import RevitServices
from RevitServices.Persistence import DocumentManager
doc = DocumentManager.Instance.CurrentDBDocument

def get_all_BIC():

    db = [
    Autodesk.Revit.DB.BuiltInCategory.OST_Floors,
    Autodesk.Revit.DB.BuiltInCategory.OST_Roofs,
    Autodesk.Revit.DB.BuiltInCategory.OST_Walls,
    Autodesk.Revit.DB.BuiltInCategory.OST_StructuralFoundation,
    Autodesk.Revit.DB.BuiltInCategory.OST_StructuralColumns,
    Autodesk.Revit.DB.BuiltInCategory.OST_StructuralFraming,
    Autodesk.Revit.DB.BuiltInCategory.OST_Ceilings,
    Autodesk.Revit.DB.BuiltInCategory.OST_Doors,
    Autodesk.Revit.DB.BuiltInCategory.OST_Windows,
    Autodesk.Revit.DB.BuiltInCategory.OST_Stairs,
    #Autodesk.Revit.DB.BuiltInCategory.OST_Railings,
    ]
    return db
    
def get_allElems(doc):
    bics = get_all_BIC()
    
    def getElems(x):
        collector = FilteredElementCollector(doc)
        res = collector.OfCategory(x).WhereElementIsNotElementType().ToElements()
        return res

    def getRailElems(x):
        collector = FilteredElementCollector(doc)
        res = collector.OfCategory(x).WhereElementIsNotElementType()
        return res

    res = map(getElems, bics)
#    res = getRailElems(Autodesk.Revit.DB.BuiltInCategory.OST_RailingSystemRail)
    return res


OUT = get_allElems(doc)
# ----------------------------------------
categories_3 = Categories("OST_EdgeSlab")
all_elements_of_category_3 = ElementsOfCategory(Category=categories_3)
list_create_3 = List.Create(item0=all_elements_of_category_3)
categories_4 = Categories("OST_StairsRailing")
all_elements_of_category_4 = ElementsOfCategory(Category=categories_4)
list_create_4 = List.Create(item0=all_elements_of_category_4)
categories_5 = Categories("OST_GenericModel")
all_elements_of_category_5 = ElementsOfCategory(Category=categories_5)
type = Object.Type(object=all_elements_of_category_5)
code_block_4 = CodeBlock(i=type) { i!="Revit.Elements.DirectShape"; }
filterByBoolMask = List.FilterByBoolMask(list=all_elements_of_category_5, mask=code_block_4)
list_create_5 = List.Create(item0=filterByBoolMask.in)
join = List.Join(list0=list_create, list1=list_create_2, list2=all_elementsexceptrails, list3=list_create_3, list4=list_create_4, list5=list_create_5)

# group: 모델링된 모든 객체의 패밀리 타입 명 추출 구간 (Room 객체의 경우 Number 속성값을 합쳐서 이름 추출)
code_block_5 = CodeBlock { "\t"; }
flatten = List.Flatten(list=join)
type_2 = Object.Type(object=flatten)
code_block_6 = CodeBlock(i=type_2) { i=="Revit.Elements.Room"; }
filterByBoolMask_2 = List.FilterByBoolMask(list=flatten, mask=code_block_6)
code_block_7 = CodeBlock { "Number"; "Name"; }
getParameterValueByName = Element.GetParameterValueByName(element=filterByBoolMask_2.in, parameterName=code_block_7.out0)
getParameterValueByName_2 = Element.GetParameterValueByName(element=filterByBoolMask_2.in, parameterName=code_block_7.out1)
list_create_6 = List.Create(item0=getParameterValueByName, item1=getParameterValueByName_2)
transpose = List.Transpose(lists=list_create_6)
join_2 = String.Join(separator=code_block_5, string0=transpose)
code_block_8 = CodeBlock(i=join_2) { i[0]; }
code_block_9 = CodeBlock { "Type"; "Type Name"; }
getParameterValueByName_3 = Element.GetParameterValueByName(element=filterByBoolMask_2.out, parameterName=code_block_9.out0)
getParameterValueByName_4 = Element.GetParameterValueByName(element=getParameterValueByName_3, parameterName=code_block_9.out1)
join_list_when_room_exist = Python(IN[0]=code_block_8, IN[1]=getParameterValueByName_4)  # CPython3
# ---------- join_list_when_room_exist.python (18 lines) ----------
# Load the Python Standard and DesignScript Libraries
import sys
import clr
clr.AddReference('ProtoGeometry')
from Autodesk.DesignScript.Geometry import *

# The inputs to this node will be stored as a list in the IN variables.
dataEnteringNode = IN
rooms = IN[0]
elems = IN[1]
# Place your code below this line

if rooms:
    res = rooms+elems
else:
    res = elems
# Assign your output to the OUT variable.
OUT = res
# ----------------------------------------
list_create_7 = List.Create(item0=join_list_when_room_exist, item1=flatten)

bnote_type_and_all_eff_elems = Python(IN[0]=code_block, IN[1]=code_block_3, IN[2]=list_create_7)  # CPython3
# ---------- bnote_type_and_all_eff_elems.python (121 lines) ----------
# Load the Python Standard and DesignScript Libraries
import sys
import clr
clr.AddReference('ProtoGeometry')
from Autodesk.DesignScript.Geometry import *


################Module For Functional Programing#########################
from functools import reduce
from itertools import chain
from itertools import groupby
from copy import deepcopy

curry = lambda f: lambda a, *args: (
    f(a, *args) if (len(args)) else lambda *args: f(a, *args)
)

filter, map, reduce = curry(filter), curry(map), curry(reduce)

go = lambda *args: reduce(lambda a, f: f(a), args)  ## 함수도 축약 가능 ##


def dictUpdate(dic1, dic2):
    dic1.update(dic2)
    return dic1


def dictsMerge(dics):
    res = reduce(dictUpdate, dics)
    return res


def dictDeleteKeys(dic, keys):
    for k in keys:
        del dic[k]
    return dic


def flat(a):
    if isinstance(a, list):
        for i in a:
            yield from flat(i)
    else:
        yield a


def grpBy(iter, key):
    f, grpKeys, grps = key, [], []
    sorted_ = sorted(iter, key=f)
    for key, grp_data in groupby(sorted_, key=f):
        grpKeys.append(key)
        grps.append(list(grp_data))
    return grps, grpKeys


#########################################################################
import json

def load_from_json(_file_path=None):
    # 파일 열기 위치 선택
    if _file_path:
        file_path = _file_path

    # JSON 파일에서 데이터 로드
    try:
        with open(file_path, "r", encoding="utf-8") as file:
            loaded_data = json.load(file)

        print(f"Data successfully loaded from {file_path}\n")
        return loaded_data
    except Exception as e:
        print(f"Error loading data from JSON: {e}\n")
        return False

def save_to_json_teamStdInfo(file_path, data):
    # 상태 객체에서 데이터를 저장
    try:
        with open(file_path, "w", encoding="utf-8") as file:
            json.dump(data, file, indent=4, ensure_ascii=False)
            # json.dump(state.project_info, file, indent=4, ensure_ascii=False)
        print(f"Data successfully saved to {file_path}")
    except Exception as e:
        print(f"Error saving data to JSON: {e}")

# The inputs to this node will be stored as a list in the IN variables.
dataEnteringNode = IN
building_name = IN[0]
bnote_path = IN[1]
bnote_data = deepcopy( load_from_json(_file_path=bnote_path) )
all_elemNames, all_elems = IN[2]


# Place your code below this line

bnote_revitTypes_inBuilding = go(
    bnote_data["project-assigntype"]["children"],
    filter(lambda x: list(x["values"])[1]==building_name),
    list,
)

bnote_revitType_names_inBuilding = go(
    bnote_revitTypes_inBuilding,
    map(lambda x: x["name"]),
    list,
)

all_eff_elems = go(
    zip(all_elemNames, all_elems),
    filter(lambda x: x[0] in bnote_revitType_names_inBuilding),
    map(lambda x: \
        {
            "name": x[0],
            "elem": x[1],
        }
    ),
    list,
)


# Assign your output to the OUT variable.
OUT = bnote_revitTypes_inBuilding, all_eff_elems
# ----------------------------------------
code_block_10 = CodeBlock()
# ---------- code_block_10.designscript (15 lines) ----------
["0.Room"
,"1.Floors"
,"2.Roofs"
,"3.Walls_Ext"
,"4.Walls_Int"
,"5.St_Fdn"
,"6.St_Col"
,"7.St_Framing"
,"8.Ceilings"
,"9.Doors"
,"10.Windows"
,"11.Stairs"
,"12.Railings"
,"13.Generic"
,"14.Manual_Input"];
# ----------------------------------------
stair_calc_functions = Python()  # CPython3; unwired: IN[0]
# ---------- stair_calc_functions.python (325 lines) ----------
# Load the Python Standard and DesignScript Libraries
import clr
clr.AddReference('RevitAPI')
from Autodesk.Revit.DB import *
from Autodesk.Revit.DB import Solid, Face, PlanarFace, ViewDetailLevel, GeometryInstance

clr.AddReference('RevitServices')
from RevitServices.Persistence import DocumentManager
doc = DocumentManager.Instance.CurrentDBDocument
import math

# The inputs to this node will be stored as a list in the IN variables.
dataEnteringNode = IN

# Place your code below this line
class StairCalc:
    def find_A_Landing(self, stair):
        stair = UnwrapElement(stair)
        options = Options()
        total_area_m2 = 0.0

        # 1. Get landing elements
        landing_ids = stair.GetStairsLandings()
        landings = [doc.GetElement(lid) for lid in landing_ids]

        # 2. Loop through each landing geometry
        for landing in landings:
            geom = landing.get_Geometry(options)
            for solid in geom:
                if not isinstance(solid, Solid):
                    continue
                for face in solid.Faces:
                    # 3. Only use horizontal (upward-facing) planar faces
                    if isinstance(face, PlanarFace):
                        normal = face.FaceNormal
                        if abs(normal.Z - 1.0) < 0.01:  # Z+ 방향이면 수평면
                            total_area_m2 += face.Area * 0.092903  # ft² → m²

        res = total_area_m2
        return res

    def find_A_Riser(self, stair):
        stair = UnwrapElement(stair)
        FT2_TO_M2 = 0.092903
        total_area_m2 = 0.0

        run_ids = stair.GetStairsRuns()
        runs = [doc.GetElement(rid) for rid in run_ids]

        for run in runs:
            try:
                tread_width = run.get_ActualRunWidth()  # ft
                run_height = run.get_Height()  # ft
                tread_count = run.get_ActualTreadsNumber()  # int

                if None in [tread_width, run_height, tread_count] or tread_count == 0:
                    continue

                # 전체 높이 / 디딤수 = Riser Height
                riser_height = run_height / tread_count

                area_ft2 = tread_width * riser_height * tread_count
                total_area_m2 += area_ft2 * FT2_TO_M2

            except:
                continue

        return total_area_m2

    def find_A_Tread(self, stair):
        stair = UnwrapElement(stair)
        from Autodesk.Revit.DB import (
            GeometryInstance,
            Solid,
            PlanarFace,
            ViewDetailLevel,
        )

        options = Options()
        options.DetailLevel = ViewDetailLevel.Fine
        options.IncludeNonVisibleObjects = True

        total_area_m2 = 0.0
        run_ids = stair.GetStairsRuns()
        runs = [doc.GetElement(rid) for rid in run_ids]

        for run in runs:
            geom = run.get_Geometry(options)
            if not geom:
                continue
            for g in geom:
                solids = []
                # 직접 Solid인 경우
                if isinstance(g, Solid) and g.Faces.Size > 0:
                    solids.append(g)
                # GeometryInstance 내부 파기
                elif isinstance(g, GeometryInstance):
                    inst_geom = g.GetInstanceGeometry()
                    for sub_geom in inst_geom:
                        if isinstance(sub_geom, Solid) and sub_geom.Faces.Size > 0:
                            solids.append(sub_geom)

                # 이제 solid 처리
                for solid in solids:
                    for face in solid.Faces:
                        if isinstance(face, PlanarFace):
                            normal = face.FaceNormal
                            if normal.Z > 0.8:  # 상향 수평면
                                total_area_m2 += face.Area * 0.092903

        return total_area_m2

    def get_support_elements(self, run):
        support_elems = []
        for ref_id in run.GetLeftSupports() + run.GetRightSupports():
            elem = doc.GetElement(ref_id)
            if elem:
                support_elems.append(elem)
        return support_elems

    def find_SA_Stringer(self, stair):
        stair = UnwrapElement(stair)
        FT2_TO_M2 = 0.092903
        total_area_m2 = 0.0
        options = Options()
        options.DetailLevel = ViewDetailLevel.Fine
        options.IncludeNonVisibleObjects = True

        run_ids = stair.GetStairsRuns()
        runs = [doc.GetElement(rid) for rid in run_ids]

        for run in runs:
            supports = get_support_elements(run)

            for support in supports:
                geom = support.get_Geometry(options)
                if not geom:
                    continue

                solids = []
                for g in geom:
                    if isinstance(g, Solid) and g.Faces.Size > 0:
                        solids.append(g)
                    elif isinstance(g, GeometryInstance):
                        for sg in g.GetInstanceGeometry():
                            if isinstance(sg, Solid) and sg.Faces.Size > 0:
                                solids.append(sg)

                for solid in solids:
                    for face in solid.Faces:
                        total_area_m2 += face.Area * FT2_TO_M2

        return total_area_m2

    def find_V_Stringer(self, stair):
        stair = UnwrapElement(stair)
        FT3_TO_M3 = 0.0283168
        total_volume_m3 = 0.0
        options = Options()
        options.DetailLevel = ViewDetailLevel.Fine
        options.IncludeNonVisibleObjects = True

        run_ids = stair.GetStairsRuns()
        runs = [doc.GetElement(rid) for rid in run_ids]

        for run in runs:
            supports = get_support_elements(run)

            for support in supports:
                geom = support.get_Geometry(options)
                if not geom:
                    continue

                solids = []
                for g in geom:
                    if isinstance(g, Solid) and g.Volume > 0:
                        solids.append(g)
                    elif isinstance(g, GeometryInstance):
                        for sg in g.GetInstanceGeometry():
                            if isinstance(sg, Solid) and sg.Volume > 0:
                                solids.append(sg)

                for solid in solids:
                    total_volume_m3 += solid.Volume * FT3_TO_M3

        return total_volume_m3

    def find_L_Landing(self, stair):
        stair = UnwrapElement(stair)
        total_short_length = 0.0

        # 계단의 랜딩(landing) 요소들 가져오기
        landing_ids = stair.GetStairsLandings()

        for lid in landing_ids:
            landing = doc.GetElement(lid)
            if landing is None:
                continue

            bbox = landing.get_BoundingBox(doc.ActiveView)
            if bbox is None:
                continue

            # XYZ 빼기 연산은 직접 안 되므로 축별로 처리
            dx = abs(bbox.Max.X - bbox.Min.X)
            dy = abs(bbox.Max.Y - bbox.Min.Y)

            short_len = min(dx, dy)
            total_short_length += short_len

        # 단위: 피트 → 미터
        total_short_length_m = total_short_length * 0.3048
        print(f"??? : {total_short_length_m}")

        return total_short_length_m

    def find_L_Run(self, stair):
        print(f"??? : 시작")
        stair = UnwrapElement(stair)

        total_run_length = 0.0

        print(f"run ids 구하기")
        run_ids = stair.GetStairsRuns()
        print(f"run ids : {run_ids}")
        for rid in run_ids:
            run = doc.GetElement(rid)
            print(f"run id : {rid}")
            if run is None:
                continue

            # ✅ 파라미터로 접근
            riser_param = run.LookupParameter("Actual Riser Height")
            tread_param = run.LookupParameter("Actual Tread Depth")
            treads_param = run.LookupParameter("Actual Number of Treads")

            if not (riser_param and tread_param and treads_param):
                continue

            if not (
                riser_param.HasValue and tread_param.HasValue and treads_param.HasValue
            ):
                continue

            # 파라미터 값 추출
            riser_height = riser_param.AsDouble()
            tread_depth = tread_param.AsDouble()
            num_treads = treads_param.AsInteger()

            # 러닝 길이 = 대각선 길이 × 단수
            step_length = math.sqrt(riser_height**2 + tread_depth**2)
            run_length = step_length * num_treads
            total_run_length += run_length

        # 단위 변환: 피트 → 미터
        total_run_length_m = total_run_length * 0.3048
        print(f"??? : {total_run_length_m}")

        return total_run_length_m

# door calculation
class ParamFinder:
    def get_param_value(self, element, keys):
        # 먼저 인스턴스에서 찾기
        for key in keys:
            param = element.LookupParameter(key)
            if param and param.HasValue:
                return param.AsDouble()
        # 없으면 타입에서 찾기
        symbol = element.Symbol
        for key in keys:
            param = symbol.LookupParameter(key)
            if param and param.HasValue:
                return param.AsDouble()
        return None

    def parse_size_from_type_name(self, type_name):
        try:
            # 패턴: W숫자xH숫자, w숫자xh숫자, 숫자x숫자 (공백 허용)
            match = re.search(
                r"[Ww]?\s*(\d{3,4})\s*[xX]\s*[Hh]?\s*(\d{3,4})", type_name
            )
            if match:
                width_mm = int(match.group(1))
                height_mm = int(match.group(2))
                return (width_mm / 1000.0) * (height_mm / 1000.0)
        except:
            pass
        return None


class CalculationDoorArea(ParamFinder):
    def __call__(self, door):
        return self.calc_door_area(door)

    def calc_door_area(self, door):
        door = UnwrapElement(door)

        width_keys = ["Width", "폭"]
        height_keys = ["Height", "높이"]

        width = self.get_param_value(door, width_keys)
        height = self.get_param_value(door, height_keys)

        if width and height:
            area = width * height * 0.092903  # ft² → m²
            result = round(area, 2)
        else:
            door_type = doc.GetElement(door.GetTypeId())
            type_name = door_type.get_name()
            area_from_name = self.parse_size_from_type_name(type_name)
            if area_from_name:
                result = round(area_from_name, 2)
            else:
                result = "면적 계산 실패"

        return result


#use like [ result = calc_door_area(door) ]
calc_door_area = CalculationDoorArea()


# Assign your output to the OUT variable.
OUT = [StairCalc(),calc_door_area]
# ----------------------------------------
calculation_stair표기수정 = Python(IN[0]=code_block, IN[1]=code_block_3, IN[2]=bnote_type_and_all_eff_elems, IN[3]=code_block_10, IN[4]=stair_calc_functions)  # CPython3
# ---------- calculation_stair표기수정.python (490 lines) ----------
# Load the Python Standard and DesignScript Libraries
import sys
import clr

clr.AddReference("ProtoGeometry")
from Autodesk.DesignScript.Geometry import *
import math

clr.AddReference("RevitAPI")
from Autodesk.Revit.DB import *

clr.AddReference("RevitServices")
from RevitServices.Persistence import DocumentManager

################Module For Functional Programing#########################
from functools import reduce
from itertools import chain
from itertools import groupby
from copy import deepcopy

curry = lambda f: lambda a, *args: (
    f(a, *args) if (len(args)) else lambda *args: f(a, *args)
)

filter, map, reduce = curry(filter), curry(map), curry(reduce)

go = lambda *args: reduce(lambda a, f: f(a), args)  ## 함수도 축약 가능 ##


def dictUpdate(dic1, dic2):
    dic1.update(dic2)
    return dic1


def dictsMerge(dics):
    res = reduce(dictUpdate, dics)
    return res


def dictDeleteKeys(dic, keys):
    for k in keys:
        del dic[k]
    return dic


def flat(a):
    if isinstance(a, list):
        for i in a:
            yield from flat(i)
    else:
        yield a


def grpBy(iter, key):
    f, grpKeys, grps = key, [], []
    sorted_ = sorted(iter, key=f)
    for key, grp_data in groupby(sorted_, key=f):
        grpKeys.append(key)
        grps.append(list(grp_data))
    return grps, grpKeys


#########################################################################
import json


def load_from_json(_file_path=None):
    # 파일 열기 위치 선택
    if _file_path:
        file_path = _file_path

    # JSON 파일에서 데이터 로드
    try:
        with open(file_path, "r", encoding="utf-8") as file:
            loaded_data = json.load(file)

        print(f"Data successfully loaded from {file_path}\n")
        return loaded_data
    except Exception as e:
        print(f"Error loading data from JSON: {e}\n")
        return False


def save_to_json_teamStdInfo(file_path, data):
    # 상태 객체에서 데이터를 저장
    try:
        with open(file_path, "w", encoding="utf-8") as file:
            json.dump(data, file, indent=4, ensure_ascii=False)
            # json.dump(state.project_info, file, indent=4, ensure_ascii=False)
        print(f"Data successfully saved to {file_path}")
    except Exception as e:
        print(f"Error saving data to JSON: {e}")


# The inputs to this node will be stored as a list in the IN variables.
dataEnteringNode = IN
building_name = IN[0]
bnote_path = IN[1]
bnote_data = deepcopy(load_from_json(_file_path=bnote_path))
# all_elemNames, all_elems = IN[2]
bnote_revitTypes_inBuilding, all_eff_elems = IN[2]
category_names = IN[3]
[stair_func, calc_door_area] = IN[4]


# Place your code below this line


def get_param_value(elem, param_unit_str):
    unit_factor = None
    if len(param_unit_str.split("|")) > 1:
        name, unit_factor = go(
            param_unit_str.split("|"),
            map(lambda x: x.strip()),
            list,
        )
    else:
        name = param_unit_str.strip()
    # print(param_unit_str)

    if name.startswith("!"):
        if name == "!Conc_Stair_Volume":
            try:
                calc_v = go(
                    elem.Geometry(),
                    map(lambda x: x.Volume / 10**9),
                    list,
                    sum,
                )
            except:
                calc_v = 0
        elif name == "!Conc_Stair_Form":
            try:
                calc_v = go(
                    elem.Geometry(),
                    map(lambda x: x.Explode()),
                    lambda x: list(chain(*x)),
                    filter(lambda x: x.NormalAtParameter(0.5, 0.5).Z != 1),
                    map(lambda x: x.Area / 10**6),
                    list,
                    sum,
                )
            except:
                calc_v = 0
        elif name == "!St_Stair_Area_Landing":
            try:
                calc_v = stair_func.find_A_Landing(elem)
            except:
                calc_v = 0
        elif name == "!St_Stair_Area_Riser":
            try:
                calc_v = stair_func.find_A_Riser(elem)
            except:
                calc_v = 0
        elif name == "!St_Stair_Area_Tread":
            try:
                calc_v = stair_func.find_A_Tread(elem)
            except:
                calc_v = 0
        elif name == "!St_Stair_SurfaceArea_Stringer":
            try:
                calc_v = stair_func.find_SA_Stringer(elem)
            except:
                calc_v = 0
        elif name == "!St_Stair_Volume_Stringer":
            try:
                calc_v = stair_func.find_V_Stringer(elem)
            except:
                calc_v = 0
        elif name == "!St_Stair_Length_Landing":
            try:
                calc_v = stair_func.find_L_Landing(elem)
            except:
                calc_v = 0
        elif name == "!St_Stair_Length_Run":
            try:
                calc_v = stair_func.find_L_Run(elem)
            except:
                calc_v = 0
        elif name == "!DoorArea":
            try:
                calc_v = calc_door_area(elem)
            except:
                calc_v = 0

    elif name not in list(map(lambda x: x.Name, elem.Parameters)):
        calc_v = elem.ElementType.GetParameterValueByName(name)
    elif name == "H_Room H or CH":
        if elem.GetParameterValueByName(name) == "":
            calc_v = elem.GetParameterValueByName("Unbounded Height")
        else:
            calc_v = elem.GetParameterValueByName(name)
    else:
        calc_v = elem.GetParameterValueByName(name)

        # print(f"부재{elem.Name}")
        # print(f"{param_unit_str}")
        # print(f"{name} 파라미터 값 {elem.GetParameterValueByName(name)}")

    if calc_v == "":
        calc_v = 0

    if unit_factor:
        res = calc_v / float(unit_factor)
    else:
        res = calc_v

    return res


def calc_elem(elem_dic):
    print("calc_elem 함수 호출")

    def check_Str(_str):
        try:
            float(_str)
            return False
        except:
            return True

    elem = elem_dic["elem"]
    print(f"elem: {elem}")

    elem_dic.update(
        {
            "GUID": elem.GetParameterValueByName("IfcGUID"),
        }
    )
    # print(f"elem_dic: {elem_dic}")

    tgt_bnoteType = go(
        bnote_revitTypes_inBuilding,
        filter(lambda x: x["name"] == elem_dic["name"]),
        filter(lambda x: x["children"] != []),
        list,
    )[0]
    # print(f"tgt_bnoteType: {tgt_bnoteType}")

    stdType_no = tgt_bnoteType["values"][-1].split(" | ")[-1].strip()
    print(stdType_no)

    cat_no = str(stdType_no).split(".")[0]

    cat_name = go(
        category_names,
        filter(lambda x: x.startswith(cat_no)),
        list,
    )[0]

    tgt_bnoteType_wmlist = go(
        tgt_bnoteType["children"],
    )

    def calc_formula(formula, calc_param_list):
        # tmp_formula = formula
        try:
            tmp_formula = go(
                formula.split("\n"),
                filter(lambda x: "#" not in x),
                list,
            )[0]
        except:
            tmp_formula = ""

        if tmp_formula != "=Exca" and tmp_formula != "=Back" and tmp_formula != "=Disp":
            for n, v in calc_param_list:
                tmp_formula = tmp_formula.replace(n, str(v))
            try:

                calc_result = eval(tmp_formula.strip("=")), "계산 성공"

            except:
                calc_result = 0, "계산 실패 - 수식 혹은 파라미터가 유효하지 않음"
        else:
            tmp_formula = formula
            calc_result = (
                0,
                "토공 항목 - [H_PAB.RT.Q2A]_Revit 토공 물량 자동산출.dyn에서 산출 요망",
            )

        # return formula, tmp_formula, *calc_result

        return {
            "수식": "'" + formula,
            "대입수식": "'" + tmp_formula,
            # "산출결과": calc_result[0],
            "산출결과": round(calc_result[0], 3),
            "산출로그": calc_result[1],
        }

    ## 헤더에 Note 추가 예정
    wm_dict_hdrs = [
        "분류",
        "표준타입",
        "상세분류",
        "wm",
        "gauge",
        "add_spec",
        "수식",
        "단위",
        "산출유형",
        "Note",
    ]

    wm_dicts = go(
        tgt_bnoteType_wmlist,
        deepcopy,
        map(lambda x: dict(zip(wm_dict_hdrs, x))),
        list,
    )
    for wm_dict in wm_dicts:
        if "Note" not in wm_dict.keys():
            wm_dict.update({"Note": ""})

    tgt_bnoteType_wm_calcvalue = []
    for wm_dict in wm_dicts:
        calcType_no = wm_dict["산출유형"]
        # print(calcType_no)
        calcdict = go(
            bnote_data["std-calcdict"]["children"],
            filter(lambda x: x["name"] == calcType_no),
            list,
        )[0]

        param_list = go(
            calcdict["children"],
            list,
            map(lambda x: x["values"]),
            list,
            map(lambda x: list(x)[1:]),
            lambda x: sorted(x, key=lambda x: len(str(x[0])), reverse=True),
            list,
        )

        calc_param_list = go(
            param_list,
            map(
                lambda x: (
                    [x[0], get_param_value(elem, x[1])]
                    if check_Str(x[1])
                    else [x[0], float(x[1])]
                )
            ),
            list,
            lambda x: sorted(x, key=lambda x: len(str(x[0])), reverse=True),
        )

        wm_dict.update(calc_formula(wm_dict["수식"], calc_param_list))
        wm_code = wm_dict["wm"].split("|")[0].strip()

        try:
            wm_desc = wm_dict["wm"].split(" | ")[7]
        except:
            wm_desc = ""

        wm_spec = go(
            wm_dict["wm"].split(" | ")[9:-4],
            filter(lambda x: not x.isnumeric()),
            filter(lambda x: not (("(   )" in x) or ("(   )" in x) or ("(  )" in x))),
            lambda x: "\n".join(x),
        )

        wm_dict.update(
            {
                "wm_code": wm_code,
                "wm_desc": wm_desc,
                "wm_spec": wm_spec,
            }
        )
        tgt_bnoteType_wm_calcvalue.append(wm_dict)

    elem_dic.update(
        {
            "cat": cat_name,
            "stdType_no": stdType_no,
            "물량": tgt_bnoteType_wm_calcvalue,
        }
    )

    # return tgt_bnoteType_wm_calcvalue
    # return tgt_bnoteType
    return elem_dic


# Flatten the nested structure into a list of rows
def flatten_data(data):
    flat_data = []
    for dic in data:
        cat = dic["cat"]
        stdType_no = dic["stdType_no"]
        elem_name = dic["name"]
        # elem = dic["elem"]
        guid = dic["GUID"]
        for item in dic["물량"]:
            flat_data.append(
                [
                    cat,
                    stdType_no,
                    item["표준타입"],
                    item["분류"],
                    elem_name,
                    guid,
                    item["상세분류"],
                    item["wm_code"],
                    item["gauge"],
                    item["wm_desc"],
                    item["wm_spec"],
                    item["add_spec"],
                    item["수식"],
                    item["대입수식"],
                    item["산출결과"],
                    item["단위"],
                    item["산출유형"],
                    item["Note"],
                    item["산출로그"],
                ]
            )
    return flat_data


data = []
for e in all_eff_elems:
    try:
        data.append(calc_elem(e))
    except:
        data.append(
            {
                "cat": "-",
                "stdType_no": "-",
                "GUID": "-",
                "name": e["name"],
                "물량": [
                    {
                        "표준타입": "-",
                        "분류": "-",
                        "상세분류": "-",
                        "wm_code": "-",
                        "gauge": "-",
                        "wm_desc": "-",
                        "wm_spec": "-",
                        "add_spec": "-",
                        "수식": "-",
                        "대입수식": "-",
                        "산출결과": 0,
                        "단위": "-",
                        "산출유형": "-",
                        "Note": "",
                        "산출로그": "실패 - 레빗타입 WM등록 여부 확인필요",
                    },
                ],
            }
        )

flat_header = [
    "카테고리",
    "표준타입번호",
    "표준타입",
    "분류",
    "name",
    "GUID",
    "상세분류",
    "wm_code",
    "gauge",
    "Description",
    "Spec.",
    "Add_spec.",
    "수식",
    "대입수식",
    "산출결과",
    "단위",
    "산출유형",
    "Note",
    "산출로그",
]

flat_data = [flat_header] + flatten_data(data)

if not bnote_data.get("dynamo-calculation"):
    bnote_data.update({"dynamo-calculation": {}})

bnote_data["dynamo-calculation"].update({building_name: flat_data})


save_to_json_teamStdInfo(bnote_path, bnote_data)

# Assign your output to the OUT variable.
# OUT = calc_elem(all_eff_elems[195])

# OUT = bnote_data
OUT = "bnote에 물량 산출결과가 업데이트 되었습니다."
# ----------------------------------------
dynamo_calculation_항목이_확인된다면_b = Watch(calculation_stair표기수정)  # "dynamo-calculation 항목이 확인된다면 B-note에서 리프레시 버튼을 누르세요."; graph output
code_block_11 = CodeBlock(i=join) { i[6][0]; }
code_block_12 = CodeBlock { "Anchor Bolt Qty"; }
getParameterValueByName_5 = Element.GetParameterValueByName(element=code_block_11, parameterName=code_block_12)
python_script = Python(IN[0]=getParameterValueByName_5)  # CPython3; frozen
# ---------- python_script.python (97 lines) ----------
# Load the Python Standard and DesignScript Libraries
import sys
import clr
clr.AddReference('ProtoGeometry')
from Autodesk.DesignScript.Geometry import *

################Module For Functional Programing#########################
from functools import reduce
from itertools import chain
from itertools import groupby
from copy import deepcopy

curry = lambda f: lambda a, *args: (
    f(a, *args) if (len(args)) else lambda *args: f(a, *args)
)

filter, map, reduce = curry(filter), curry(map), curry(reduce)

go = lambda *args: reduce(lambda a, f: f(a), args)  ## 함수도 축약 가능 ##


def dictUpdate(dic1, dic2):
    dic1.update(dic2)
    return dic1


def dictsMerge(dics):
    res = reduce(dictUpdate, dics)
    return res


def dictDeleteKeys(dic, keys):
    for k in keys:
        del dic[k]
    return dic


def flat(a):
    if isinstance(a, list):
        for i in a:
            yield from flat(i)
    else:
        yield a


def grpBy(iter, key):
    f, grpKeys, grps = key, [], []
    sorted_ = sorted(iter, key=f)
    for key, grp_data in groupby(sorted_, key=f):
        grpKeys.append(key)
        grps.append(list(grp_data))
    return grps, grpKeys


#########################################################################

# The inputs to this node will be stored as a list in the IN variables.
dataEnteringNode = IN
param_v = IN[0]
# Place your code below this line
def calc_formula(formula, calc_param_list):
    #tmp_formula = formula
    print(f"formula: {formula}")
    try:
        tmp_formula = go(
            formula.split("\n"),
            filter(lambda x: "#" not in x),
            list,
        )[0]
        print(f"tmp_formula: {tmp_formula}")
    except:
        tmp_formula = ""
        
    if tmp_formula != "=Exca" and tmp_formula != "=Back" and tmp_formula != "=Disp":
        for n,v in calc_param_list:
            tmp_formula = tmp_formula.replace(n, str(v))
            print(str(v))
            print(tmp_formula)
        try:
            calc_result = eval(tmp_formula.strip("=")), "계산 성공"
        except:
            calc_result = 0, "계산 실패 - 수식 혹은 파라미터가 유효하지 않음"
    else:
        tmp_formula = formula
        calc_result = 0, "토공 항목 - [H_PAB.RT.Q2A]_Revit 토공 물량 자동산출.dyn에서 산출 요망"
    
    #return formula, tmp_formula, *calc_result
    
    return {
        "수식": "'" + formula,
        "대입수식": "'" + tmp_formula,
        #"산출결과": calc_result[0],
        "산출결과": round(calc_result[0], 3),
        "산출로그": calc_result[1],
    }
# Assign your output to the OUT variable.
OUT = calc_formula('=AB', [['AB', param_v]])
# ----------------------------------------
watch = Watch(join)
code_block_13 = CodeBlock()
# ---------- code_block_13.designscript (15 lines) ----------
"Rooms";
"gutter";
"Floors";
"Roofs";
"Walls";
"StructuralFoundation";
"StructuralColumns";
"StructuralFraming";
"Ceilings";
"Doors";
"Windows";
"Stairs";
"Floors-slab Edge";
"Railing";
"Generic model";
# ----------------------------------------
code_block_14 = CodeBlock(i=getParameterValueByName_3) { i[109]; }
parameters = Element.Parameters(element=code_block_14)
