# Dynamo graph [H_PAB.RT.Q2]_Revit 물량 산출_[3.2.5].dyn (Dynamo 2.16.1.2727)
# author: MK Jang
# Auto Calculating the Quantities of each Element As per the Family List

n2_물량산출모드_입찰_실행 = CustomSelection("입찰", items={입찰: "입찰", 실행: "실행"})  # "2. 물량산출모드(입찰 / 실행)"

# group: Pjt Information Extract
categories = Categories("OST_ProjectInformation")
all_elements_of_category = ElementsOfCategory(Category=categories)
firstItem = List.FirstItem(list=all_elements_of_category)
code_block = CodeBlock()
# ---------- code_block.designscript (4 lines) ----------
[
"Project Name",
"Building Name"
];
# ----------------------------------------
parameterByName = Parameter.ParameterByName(element=firstItem, name=code_block)
value = Parameter.Value(parameter=parameterByName)
parameters = Element.Parameters(element=firstItem)
hasValue = Parameter.HasValue(parameter=parameters)
filterByBoolMask = List.FilterByBoolMask(list=parameters, mask=hasValue)
name = Parameter.Name(parameter=filterByBoolMask.in)
code_block_2 = CodeBlock(i=name) { i!="Category"; }
filterByBoolMask_2 = List.FilterByBoolMask(list=filterByBoolMask.in, mask=code_block_2)
value_2 = Parameter.Value(parameter=filterByBoolMask_2.in)
code_block_3 = CodeBlock(i=value_2) { i!=""; }
filterByBoolMask_3 = List.FilterByBoolMask(list=filterByBoolMask_2.in, mask=code_block_3)
name_2 = Parameter.Name(parameter=filterByBoolMask_3.in)
value_3 = Parameter.Value(parameter=filterByBoolMask_3.in)
byKeysValues = DesignScript.Builtin.Dictionary.ByKeysValues(keys=name_2, values=value_3)
stringifyJSON = Data.StringifyJSON(values=byKeysValues)
list_create = List.Create(item0=name_2, item1=value_3)

building_name = CodeBlock(bdName=value) { bdName; }

# group: HTML 부재별 물량 기입을 위한 데이터 포맷팅 구간
code_block_4 = CodeBlock()
# ---------- code_block_4.designscript (10 lines) ----------
[
"Work Master Code /w Description",
"IfcGUID / GaugeCode",
"Description",
"산출 수식",
"값 대입 수식",
"Quantity",
"Unit",
"rIDX"
];
# ----------------------------------------
code_block_5 = CodeBlock { finRes; }  # frozen; unwired: finRes
code_block_6 = CodeBlock { "GUID"; }
valueAtKey = DesignScript.Builtin.Dictionary.ValueAtKey(dictionary=code_block_5, key=code_block_6)
code_block_7 = CodeBlock(i=code_block_5) { i["type_name"]; }
list_create_2 = List.Create()  # unwired: item0
map = List.Map(list=code_block_7, function=list_create_2)
addItemToEnd = List.AddItemToEnd(item=valueAtKey@L1, list=map@L2)
code_block_8 = CodeBlock { "WM No."; "Work Master"; "GaugeCode"; }
code_block_9 = CodeBlock(i=code_block_5, a=code_block_8.out1, b=code_block_8.out2)
# ---------- code_block_9.designscript (10 lines) ----------
[
i["wm_list"][a],
i["wm_list"][b],
i["wm_list"]["Spec."],
i["wm_list"]["적용 산출식"],
i["wm_list"]["대입 산출식"],
i["wm_list"]["계산 결과"],
i["wm_list"]["Unit"],
i["wm_list"]["rIDX"]
];
# ----------------------------------------
transpose = List.Transpose(lists=code_block_9@@L4)
transpose_2 = List.Transpose(lists=transpose@@L3)
code_block_10 = CodeBlock(i=transpose_2) { i[0]; }
addItemToFront = List.AddItemToFront(item=addItemToEnd@L2, list=code_block_10@@L3, lacing=Shortest)
BOQbyElement_HTML_part = Python(IN[0]=code_block_4, IN[1]=addItemToFront)  # CPython3
# ---------- BOQbyElement_HTML_part.python (100 lines) ----------
# Load the Python Standard and DesignScript Libraries
import sys
import clr
clr.AddReference('ProtoGeometry')
from Autodesk.DesignScript.Geometry import *

clr.AddReference('RevitNodes')
import Revit
clr.ImportExtensions(Revit.Elements)
from Revit import Elements

################Module For Functional Programing#########################
from functools import reduce
from itertools import chain
from itertools import groupby
from copy import deepcopy
curry = lambda f: lambda a,*args: f(a, *args) if (len(args)) else lambda *args: f(a, *args)

filter,map,reduce = curry(filter),curry(map),curry(reduce)

go = lambda *args: reduce(lambda a,f: f(a), args) ## 함수도 축약 가능 ##

def dictUpdate(dic1,dic2):
    dic1.update(dic2)
    return dic1
    
def dictsMerge(dics):
    res = reduce(dictUpdate, dics)
    return res
    
def dictDeleteKeys(dic, keys):
    for k in keys:
        del dic[k]
    return dic

def flat(a):
    if isinstance(a, list):
        for i in a: 
            yield from flat(i)
    else: yield a
      
def grpBy(iter, key):
    f,grpKeys,grps = key,[],[]
    sorted_ = sorted(iter, key=f)
    for key, grp_data in groupby(sorted_,key=f):
        grpKeys.append(key); grps.append(list(grp_data))
    return grps,grpKeys
#########################################################################
# The inputs to this node will be stored as a list in the IN variables.
dataEnteringNode = IN
hdrs = IN[0]
grps = IN[1]
# Place your code below this line
def make_th(row):
    preStr = "<tr>"
    postStr = "</tr>"
    rowStrs = list(map(lambda x: f"<th>{x}</th>", row))
    res = "\n".join([preStr]+rowStrs+[postStr])
    return res

def make_tr(row):
    preStr = "<tr>"
    postStr = "</tr>"
    rowStrs = list(map(lambda x: f"<td>{x}</td>", row))
    res = "\n".join([preStr]+rowStrs+[postStr])
    return res

def make_trs(rows):
    rowsStrs = list(map(make_tr, rows))
    res = "\n".join(rowsStrs)
    return res

def make_trs_hd(rows):
    rowsStrs = list(map(make_th, rows))
    res = "\n".join(rowsStrs)
    return res

def make_wholeTable(rows):
    preStr = "<table>"
    postStr = "</table>"
    trs = make_trs(rows)
    res = "\n".join([preStr, trs, postStr])
    return res

def transTo_tableForm(grp):
    chkbox_tagStr = '<input type="checkbox" id="chkbox" name="checks">'

    #title = "<h5>"+grp.pop(0)+"</h5>"
    title = list(map(lambda x: "<h5>"+x+"</h5>" ,grp.pop(0)))
    #res = [title]
    res = title
    res.append(make_trs(grp))
    
    return res
    
rows = [[make_th(hdrs)]] + list(map(transTo_tableForm, grps))


# Assign your output to the OUT variable.
OUT = make_wholeTable(rows)
# ----------------------------------------
watch = Watch(addItemToFront)

# group: HTML 부재별 물량 기입 구간
javascriptPart = Python()  # CPython3; unwired: IN[0], IN[1], IN[2]
# ---------- javascriptPart.python (59 lines) ----------
# Load the Python Standard and DesignScript Libraries
import sys
import clr
clr.AddReference('ProtoGeometry')
from Autodesk.DesignScript.Geometry import *

# The inputs to this node will be stored as a list in the IN variables.
dataEnteringNode = IN

# Place your code below this line
jsPart = '''
function hideAllPages() {
        document.querySelector("#home").style.fontWeight = "normal";
        document.querySelector("#homePage").style.display = "None";
        document.querySelector("#info").style.fontWeight = "normal";
        document.querySelector("#infoPage").style.display = "None";
        document.querySelector("#famType").style.fontWeight = "normal";
        document.querySelector("#famTypePage").style.display = "None";
        document.querySelector("#roomInfo").style.fontWeight = "normal";
        document.querySelector("#roomInfoPage").style.display = "None";
        document.querySelector("#roomInfoPage_chk").style.display = "None";
}

document.querySelector("#cat").onclick = function() {
	    let img = document.createElement("img");
	    img.setAttribute("src", "https://t4.ftcdn.net/jpg/05/62/99/31/360_F_562993122_e7pGkeY8yMfXJcRmclsoIjtOoVDDgIlh.jpg");
	    document.querySelector("#cat").style.display = "None";
	    img.setAttribute("style", "width:300px;margin-top:20px;")
	    document.body.append(img);
	};
document.querySelector("#home").onclick = function() {
        hideAllPages();
        document.querySelector("#home").style.fontWeight = "bolder";
        document.querySelector("#homePage").style.display = "inline";
	};
document.querySelector("#info").onclick = function() {
        hideAllPages();
        document.querySelector("#info").style.fontWeight = "bolder";
        document.querySelector("#infoPage").style.display = "inline";
	};
document.querySelector("#famType").onclick = function() {
        hideAllPages();
        document.querySelector("#famType").style.fontWeight = "bolder";
        document.querySelector("#famTypePage").style.display = "inline";
	};
document.querySelector("#roomInfo").onclick = function() {
        hideAllPages();
        document.querySelector("#roomInfo").style.fontWeight = "bolder";
        document.querySelector("#roomInfoPage").style.display = "inline";
	};
document.querySelector("#roomInfo_chk").onclick = function() {
        hideAllPages();
        document.querySelector("#roomInfo_chk").style.fontWeight = "bolder";
        document.querySelector("#roomInfoPage_chk").style.display = "inline";
	};
	
'''
# Assign your output to the OUT variable.
OUT = jsPart
# ----------------------------------------
cssPart = Python()  # CPython3; unwired: IN[0], IN[1], IN[2]
# ---------- cssPart.python (125 lines) ----------
# Load the Python Standard and DesignScript Libraries
import sys
import clr
clr.AddReference('ProtoGeometry')
from Autodesk.DesignScript.Geometry import *

# The inputs to this node will be stored as a list in the IN variables.
dataEnteringNode = IN

# Place your code below this line
cssPart = '''

/* style.css */
img {
 width : 25%;
 height: 25%; 
}

:root {
  --text-color: #f0f4f5;
  --background-color: #263343;
  --accent-color: orange;
  --icons-color: rgb(152, 187, 201);
  --bodybackground-color: lightgray;
}

th {
  text-align: center;
  padding-left: 30px;
}

td {
  padding-left: 40px;
  border-bottom : 1px solid gray;
  border-collapse : collapse;
}

body {
  margin: 0;
  background-color: var(--bodybackground-color);
  font-family: 'STIX Two Math';
} 

a {
  text-decoration: none;
  color: var(--text-color);
}

.navbar {
  display: flex;
  position: sticky;
  top: 0px; /* 도달했을때 고정시킬 위치 */
  justify-content: space-between;
  align-items: center;
  background-color: var(--background-color);
  padding: 8px 12px;
  font-family: 'STIX Two Math';
}

.navbar__logo i {
  color: var(--accent-color);
  padding-left: 0;
}

.navbar__menu {
  list-style: none;
  display: flex;
  margin: 0;
  padding-left: 0;
}

.navbar__menu li {
  padding: 8px 30px;
  color: var(--text-color);
}

.navbar__menu li:hover {
  background-color: var(--accent-color);
  border-radius: 3px;
}

.navbar__icons {
  list-style: none;
  display: flex;
  color: var(--icons-color);
  margin: 0;
  padding-left: 0;
}

.navbar__icons li {
  padding: 8px 12px;
  margin: 0;
}

#cat {
  display: block;
  }

#home {
  font-weight: bolder;
  }

#homePage {
  display: inline;
  }

#infoPage {
  display: None;
  }

#famTypePage {
  display: None;
  }

#roomInfoPage {
  display: None;
  }

#roomInfoPage_chk {
  display: None;
  }

'''
# Assign your output to the OUT variable.
OUT = cssPart
# ----------------------------------------
navHTML_Part = Python()  # CPython3; unwired: IN[0]
# ---------- navHTML_Part.python (24 lines) ----------
# Load the Python Standard and DesignScript Libraries
import sys
import clr
clr.AddReference('ProtoGeometry')
from Autodesk.DesignScript.Geometry import *

# The inputs to this node will be stored as a list in the IN variables.
dataEnteringNode = IN

# Place your code below this line
navPart = f"""

<nav class="navbar">

  <ul class="navbar__menu">
    <li id="home">Home</li>
  </ul>

</nav>

"""

# Assign your output to the OUT variable.
OUT = navPart
# ----------------------------------------
list_create_3 = List.Create(item0=BOQbyElement_HTML_part)
make_htmlStr = Python(IN[0]=javascriptPart, IN[1]=cssPart, IN[2]=navHTML_Part, IN[3]=building_name, IN[4]=list_create_3)  # CPython3
# ---------- make_htmlStr.python (59 lines) ----------
# Load the Python Standard and DesignScript Libraries
import sys
import clr
clr.AddReference('ProtoGeometry')
from Autodesk.DesignScript.Geometry import *

# The inputs to this node will be stored as a list in the IN variables.
dataEnteringNode = IN
jsPart = IN[0]
cssPart = IN[1]
navPart = IN[2]

pjtName = IN[3][0]
bdName = IN[3][1]
pages = IN[4]

homePage = pages[0]



# Place your code below this line
##folderPath_r = folderPath.replace('\\','\\\\')

htmlStr = f'''
<!DOCTYPE html>
<html lang="ko">

<head>
    <link rel="shortcut icon" href="#">
    <meta charset="UTF-8">
    <title>RVT Calculation Result</title>
    <style>
        {cssPart}
    </style>
</head>

<header>
<h5>Revit Elements' Bill of Quantities Page</h5>
<h4>{pjtName}</h4>
<h4>{bdName}</h4>
</header>

<body>
{navPart}

<div id="homePage">
{homePage}
</div>



<script type ="module" src="./js/script.js"></script>

</body>

</html>
'''
# Assign your output to the OUT variable.
OUT = htmlStr
# ----------------------------------------
code_block_11 = CodeBlock(htmlStr=make_htmlStr) { htmlStr; }
serverFilePath = CodeBlock { ".dynTemp"; }  # frozen
htmlPath = Python(IN[0]=serverFilePath)  # CPython3
# ---------- htmlPath.python (35 lines) ----------
# Load the Python Standard and DesignScript Libraries
import sys
import clr
clr.AddReference('ProtoGeometry')
from Autodesk.DesignScript.Geometry import *
import time
import subprocess
import os

clr.AddReference('RevitNodes')
import Revit
clr.ImportExtensions(Revit.Elements)
from Revit import Elements
# The inputs to this node will be stored as a list in the IN variables.
dataEnteringNode = IN
dynTempServerPath = IN[0]
# Place your code below this line
def find_cwd():
    doc = Revit.Application.Document.Current
    filePath_string = doc.FilePath
    folderPath = filePath_string.split('\\')
    folderPath.pop(-1)
    folderPath_str = '\\'.join(folderPath)
    return folderPath_str

cwd = find_cwd()
#cwd = os.getenv("HomePath")

folderPath = f"{cwd}\\{dynTempServerPath}\\tmpForBOQ"
if not os.path.exists(folderPath):
    os.makedirs(folderPath)

# Assign your output to the OUT variable.
#OUT = "C:"+folderPath
OUT = folderPath
# ----------------------------------------
n0_set_port_number_기본값_8000_작동_오류 = StringInput("8000")  # "0. Set Port Number: 기본값-8000 (작동 오류 없다면 변경 금지)"
create_html_file_and_open = Python(IN[0]=code_block_11, IN[1]=htmlPath, IN[2]=n0_set_port_number_기본값_8000_작동_오류)  # CPython3
# ---------- create_html_file_and_open.python (85 lines) ----------
# Load the Python Standard and DesignScript Libraries
import os
import sys
import clr
clr.AddReference('ProtoGeometry')
from Autodesk.DesignScript.Geometry import *

clr.AddReference('RevitNodes')
import Revit
clr.ImportExtensions(Revit.Elements)
from Revit import Elements

import time
import subprocess
import asyncio
import multiprocessing

#################################Module For Functional Programing#############################################
from functools import reduce
curry = lambda f: lambda a,*args: f(a, *args) if (len(args)) else lambda *args: f(a, *args)

filter = curry(filter)
map = curry(map)

def _take(length, iter):
    res = []
    for a in iter:
        res.append(a)
        if len(res) == length:
            return res
        
take = curry(_take)
reduce = curry(reduce)

go = lambda *args: reduce(lambda a,f: f(a), args) ## 함수도 축약 가능 ##
##############################################################################################################

# The inputs to this node will be stored as a list in the IN variables.
dataEnteringNode = IN
contents = IN[0]
folderPath = IN[1]
cwd = folderPath
portNo = IN[2]
#bdName = IN[2]
# Place your code below this line

def find_cwd():
    doc = Revit.Application.Document.Current
    filePath_string = doc.FilePath
    folderPath = filePath_string.split('\\')
    folderPath.pop(-1)
    folderPath_str = '\\'.join(folderPath)
    return folderPath_str

def make_resultHTMLname(htmlStr,title,cwd):
    timeStamp = time.strftime('%H_%M_%S', time.localtime(time.time()))
    #folderPath = f"{cwd}\\.dynLog"
    folderPath = cwd
    if not os.path.exists(folderPath):
        os.makedirs(folderPath)
    fileName = f"index.html"
    filePath = f"{folderPath}\\" + fileName
    f = open(filePath, 'w', encoding='utf8')
    f.write(htmlStr)
    f.close()
    return fileName


def execute_browser(cwd):
    #cwd = find_cwd()
    folderPath = cwd
    os.chdir(folderPath)
    #cmdStr = "start chrome http:localhost:8000"
    cmdStr = f"start msedge http:localhost:{portNo}"
    cmdList= cmdStr.split(' ')
    #subprocess.run(args=[fileName], shell=True)
    #subprocess.run(args=['start','excel',fileName], shell=True)
    subprocess.run(args=cmdList, shell=True)
    return cmdList


fileName = make_resultHTMLname(contents,"test",cwd)

# Assign your output to the OUT variable.
OUT = execute_browser(cwd)#fileName.split('.')[0]
# ----------------------------------------
create_js_file = Python(IN[0]=javascriptPart, IN[1]=htmlPath)  # CPython3; unwired: IN[2]
# ---------- create_js_file.python (84 lines) ----------
# Load the Python Standard and DesignScript Libraries
import os
import sys
import clr
clr.AddReference('ProtoGeometry')
from Autodesk.DesignScript.Geometry import *

clr.AddReference('RevitNodes')
import Revit
clr.ImportExtensions(Revit.Elements)
from Revit import Elements

import time
import subprocess

#################################Module For Functional Programing#############################################
from functools import reduce
curry = lambda f: lambda a,*args: f(a, *args) if (len(args)) else lambda *args: f(a, *args)

filter = curry(filter)
map = curry(map)

def _take(length, iter):
    res = []
    for a in iter:
        res.append(a)
        if len(res) == length:
            return res
        
take = curry(_take)
reduce = curry(reduce)

go = lambda *args: reduce(lambda a,f: f(a), args) ## 함수도 축약 가능 ##
##############################################################################################################

# The inputs to this node will be stored as a list in the IN variables.
dataEnteringNode = IN
contents = IN[0]
folderPath = IN[1]
#bdName = IN[2]
# Place your code below this line
def find_cwd():
    doc = Revit.Application.Document.Current
    filePath_string = doc.FilePath
    folderPath = filePath_string.split('\\')
    folderPath.pop(-1)
    folderPath_str = '\\'.join(folderPath)
    return folderPath_str

#cwd = find_cwd()
cwd = folderPath

def make_resultHTMLname(jsStr,cwd):
    #timeStamp = time.strftime('%H_%M_%S', time.localtime(time.time()))
    #folderPath = f"{cwd}\\.dynLog"
    folderPath = cwd
    jsPath = cwd + "\\js"
    if not os.path.exists(folderPath):
        os.makedirs(folderPath)
    if not os.path.exists(jsPath):
        os.makedirs(jsPath)
    fileName = "script.js"
    filePath = f"{jsPath}\\" + fileName
    f = open(filePath, 'w', encoding='utf8')
    f.write(jsStr)
    f.close()
    return fileName

def execute_file(fileName):
    #cwd = find_cwd()
    folderPath = cwd
    os.chdir(folderPath)
    subprocess.run(args=[fileName], shell=True)
    #subprocess.run(args=['start','excel',fileName], shell=True)
    

fileName = make_resultHTMLname(contents,cwd)
#fileName = "Test1.html"

#execute_file(fileName)


# Assign your output to the OUT variable.
OUT = fileName
# ----------------------------------------
start_webserver = Python(IN[0]=htmlPath, IN[1]=n0_set_port_number_기본값_8000_작동_오류)  # CPython3
# ---------- start_webserver.python (48 lines) ----------
# Load the Python Standard and DesignScript Libraries
import sys
import clr
clr.AddReference('ProtoGeometry')
from Autodesk.DesignScript.Geometry import *

import os
import asyncio
import multiprocessing
import subprocess
# The inputs to this node will be stored as a list in the IN variables.
dataEnteringNode = IN
cwd = IN[0]
portNo = IN[1]
# Place your code below this line
batStr = f"""
@echo on
python -m http.server {portNo}
cmd /k
"""
##cmd /k
title = "localWebserver"

def make_startSever_bat(batStr,title,cwd):
    folderPath = cwd
    if not os.path.exists(folderPath):
        os.makedirs(folderPath)
    fileName = f"{title}.bat"
    filePath = f"{folderPath}\\" + fileName
    f = open(filePath, 'w', encoding='utf8')
    f.write(batStr)
    f.close()
    return fileName

def startBat(fileName, cwd):
    cmdStr = f".\\{fileName}"
    cmdList= cmdStr.split(' ')
    os.chdir(cwd)
    
    res = subprocess.Popen(args=cmdList, shell=True)
    return res

batFileName = make_startSever_bat(batStr,title,cwd)
#res = multiprocessing.Process(name="SubProcess", target=startBat, args=(batFileName, cwd))
# Assign your output to the OUT variable.
OUT = startBat(batFileName, cwd)

#startBat(fileName, cwd)
# ----------------------------------------
make_htmlStr_2 = Python(IN[0]=javascriptPart, IN[1]=cssPart)  # CPython3; frozen; unwired: IN[2]
# ---------- make_htmlStr_2.python (53 lines) ----------
# Load the Python Standard and DesignScript Libraries
import sys
import clr
clr.AddReference('ProtoGeometry')
from Autodesk.DesignScript.Geometry import *

# The inputs to this node will be stored as a list in the IN variables.
dataEnteringNode = IN
jsPart = IN[0]
cssPart = IN[1]
tablePart = IN[2]

# Place your code below this line
##folderPath_r = folderPath.replace('\\','\\\\')

htmlStr = f'''
<!DOCTYPE html>
<html lang="ko">

<head>
    <meta charset="UTF-8">
    <title>my first three.js app</title>
    <style>
        {cssPart}
    </style>
</head>

<body>


<div class="wrapper">

  <a data-fslightbox="gallery" href="#custom-source">
    유튜브 라이트박스
  </a>

  <iframe id="custom-source"
          frameborder="0"
          width="1920px"
          height="1080px"
          allow="autoplay; fullscreen"
          src="https://www.youtube.com/embed/qgBSiRwsbNw?autoplay=1">
  </iframe>
</div>

<script src="https://cdnjs.cloudflare.com/ajax/libs/fslightbox/3.3.1/index.min.js" integrity="sha512-EqNNJuepkw5P9vxCml8eBk7C4Ld+4kAnvzOD/jG21rkxWPILGoQa5EvD62UieiJF0u3xoQrcVnce4i83VnYj/Q==" crossorigin="anonymous" referrerpolicy="no-referrer"></script>

</body>

</html>
'''
# Assign your output to the OUT variable.
OUT = htmlStr
# ----------------------------------------

code_block_12 = CodeBlock()
# ---------- code_block_12.designscript (15 lines) ----------
["0.Room"
,"1.Floors"
,"2.Roofs"
,"3.Walls_Ext"
,"3.Walls_Int"
,"4.St_Fdn"
,"5.St_Col"
,"6.St_Framing"
,"7.Ceilings"
,"8.Doors"
,"9.Windows"
,"10.Stairs"
,"11.Railings"
,"12.Generic"
,"13.Manual_Input"];
# ----------------------------------------

# group: All Data In B-note
n1_family_list_경로_입력 = Filename("..\H_BimNote\fl_lat.xlsx")  # "1. Family List 경로 입력"; frozen
n2_b_note_파일_경로_입력 = Filename("..\..\..\Teams Received\팀 Family List_Template_2025.02.03_HGEN_STB (1).bnote")  # "▶ 2. B-note 파일 경로 입력 >>"; graph input

code_block_13 = CodeBlock(file_path=n2_b_note_파일_경로_입력) { file_path; }
code_block_14 = CodeBlock(file_path=code_block_13) { file_path; }
make_excel_path = Python(IN[0]=code_block_14)  # CPython3
# ---------- make_excel_path.python (76 lines) ----------
# Load the Python Standard and DesignScript Libraries
import sys
import clr
clr.AddReference('ProtoGeometry')
from Autodesk.DesignScript.Geometry import *
import datetime

################Module For Functional Programing#########################
from functools import reduce
from itertools import chain
from itertools import groupby
from copy import deepcopy

curry = lambda f: lambda a, *args: (
    f(a, *args) if (len(args)) else lambda *args: f(a, *args)
)

filter, map, reduce = curry(filter), curry(map), curry(reduce)

go = lambda *args: reduce(lambda a, f: f(a), args)  ## 함수도 축약 가능 ##


def dictUpdate(dic1, dic2):
    dic1.update(dic2)
    return dic1


def dictsMerge(dics):
    res = reduce(dictUpdate, dics)
    return res


def dictDeleteKeys(dic, keys):
    for k in keys:
        del dic[k]
    return dic


def flat(a):
    if isinstance(a, list):
        for i in a:
            yield from flat(i)
    else:
        yield a


def grpBy(iter, key):
    f, grpKeys, grps = key, [], []
    sorted_ = sorted(iter, key=f)
    for key, grp_data in groupby(sorted_, key=f):
        grpKeys.append(key)
        grps.append(list(grp_data))
    return grps, grpKeys


#########################################################################

# The inputs to this node will be stored as a list in the IN variables.
dataEnteringNode = IN
bnote_path = IN[0]
# Place your code below this line

def make_excel_path(bnote_path):
    seg = bnote_path.split("\\")
    bnote_name = seg[-1].split(".bnote")[0]
    now = datetime.datetime.now()
    stamp = now.strftime("%m%d-%I%M%S")
    excel_name = f"{bnote_name}_excel_qty_result_{stamp}"
    excel_path = "\\".join(seg[:-1]) +"\\"+ excel_name

    return excel_path



# Assign your output to the OUT variable.
OUT = make_excel_path(bnote_path)
# ----------------------------------------
code_block_15 = CodeBlock { "calc"; }
code_block_16 = CodeBlock { 0; }
n1_building_name_b_note_상의_이름과 = StringInput("Steam Turbine Building")  # "▶ 1. Building Name (B-note 상의 이름과 동일해야 합니다.) >>"; graph input
code_block_17 = CodeBlock(building_name=n1_building_name_b_note_상의_이름과) { building_name; }

# group: All Elements in Revit
categories_2 = Categories("OST_Rooms")
all_elements_of_category_2 = ElementsOfCategory(Category=categories_2)
list_create_4 = List.Create(item0=all_elements_of_category_2)
categories_3 = Categories("OST_Gutter")
all_elements_of_category_3 = ElementsOfCategory(Category=categories_3)
list_create_5 = List.Create(item0=all_elements_of_category_3)
all_elementsexceptrails = Python()  # CPython3; unwired: IN[0]
# ---------- all_elementsexceptrails.python (51 lines) ----------
# Load the Python Standard and DesignScript Libraries
import sys
import clr
clr.AddReference('ProtoGeometry')
from Autodesk.DesignScript.Geometry import *

clr.AddReference('RevitAPI')
from Autodesk.Revit.DB import *
import Autodesk

clr.AddReference('RevitServices')
import RevitServices
from RevitServices.Persistence import DocumentManager
doc = DocumentManager.Instance.CurrentDBDocument

def get_all_BIC():

    db = [
    Autodesk.Revit.DB.BuiltInCategory.OST_Floors,
    Autodesk.Revit.DB.BuiltInCategory.OST_Roofs,
    Autodesk.Revit.DB.BuiltInCategory.OST_Walls,
    Autodesk.Revit.DB.BuiltInCategory.OST_StructuralFoundation,
    Autodesk.Revit.DB.BuiltInCategory.OST_StructuralColumns,
    Autodesk.Revit.DB.BuiltInCategory.OST_StructuralFraming,
    Autodesk.Revit.DB.BuiltInCategory.OST_Ceilings,
    Autodesk.Revit.DB.BuiltInCategory.OST_Doors,
    Autodesk.Revit.DB.BuiltInCategory.OST_Windows,
    Autodesk.Revit.DB.BuiltInCategory.OST_Stairs,
    #Autodesk.Revit.DB.BuiltInCategory.OST_Railings,
    ]
    return db
    
def get_allElems(doc):
    bics = get_all_BIC()
    
    def getElems(x):
        collector = FilteredElementCollector(doc)
        res = collector.OfCategory(x).WhereElementIsNotElementType().ToElements()
        return res

    def getRailElems(x):
        collector = FilteredElementCollector(doc)
        res = collector.OfCategory(x).WhereElementIsNotElementType()
        return res

    res = map(getElems, bics)
#    res = getRailElems(Autodesk.Revit.DB.BuiltInCategory.OST_RailingSystemRail)
    return res


OUT = get_allElems(doc)
# ----------------------------------------
categories_4 = Categories("OST_EdgeSlab")
all_elements_of_category_4 = ElementsOfCategory(Category=categories_4)
list_create_6 = List.Create(item0=all_elements_of_category_4)
categories_5 = Categories("OST_StairsRailing")
all_elements_of_category_5 = ElementsOfCategory(Category=categories_5)
list_create_7 = List.Create(item0=all_elements_of_category_5)
categories_6 = Categories("OST_GenericModel")
all_elements_of_category_6 = ElementsOfCategory(Category=categories_6)
type = Object.Type(object=all_elements_of_category_6)
code_block_18 = CodeBlock(i=type) { i!="Revit.Elements.DirectShape"; }
filterByBoolMask_4 = List.FilterByBoolMask(list=all_elements_of_category_6, mask=code_block_18)
list_create_8 = List.Create(item0=filterByBoolMask_4.in)
join = List.Join(list0=list_create_4, list1=list_create_5, list2=all_elementsexceptrails, list3=list_create_6, list4=list_create_7, list5=list_create_8)

# group: 모델링된 모든 객체의 패밀리 타입 명 추출 구간 (Room 객체의 경우 Number 속성값을 합쳐서 이름 추출)
code_block_19 = CodeBlock { "\t"; }
flatten = List.Flatten(list=join)
type_2 = Object.Type(object=flatten)
code_block_20 = CodeBlock(i=type_2) { i=="Revit.Elements.Room"; }
filterByBoolMask_5 = List.FilterByBoolMask(list=flatten, mask=code_block_20)
code_block_21 = CodeBlock { "Number"; "Name"; }
getParameterValueByName = Element.GetParameterValueByName(element=filterByBoolMask_5.in, parameterName=code_block_21.out0)
getParameterValueByName_2 = Element.GetParameterValueByName(element=filterByBoolMask_5.in, parameterName=code_block_21.out1)
list_create_9 = List.Create(item0=getParameterValueByName, item1=getParameterValueByName_2)
transpose_3 = List.Transpose(lists=list_create_9)
join_2 = String.Join(separator=code_block_19, string0=transpose_3)
code_block_22 = CodeBlock(i=join_2) { i[0]; }
code_block_23 = CodeBlock { "Type"; "Type Name"; }
getParameterValueByName_3 = Element.GetParameterValueByName(element=filterByBoolMask_5.out, parameterName=code_block_23.out0)
getParameterValueByName_4 = Element.GetParameterValueByName(element=getParameterValueByName_3, parameterName=code_block_23.out1)
join_3 = List.Join(list0=code_block_22, list1=getParameterValueByName_4)
list_create_10 = List.Create(item0=join_3, item1=flatten)

code_block_24 = CodeBlock()
# ---------- code_block_24.designscript (15 lines) ----------
["0.Room"
,"1.Floors"
,"2.Roofs"
,"3.Walls_Ext"
,"4.Walls_Int"
,"5.St_Fdn"
,"6.St_Col"
,"7.St_Framing"
,"8.Ceilings"
,"9.Doors"
,"10.Windows"
,"11.Stairs"
,"12.Railings"
,"13.Generic"
,"14.Manual_Input"];
# ----------------------------------------
calculation = Python(IN[0]=code_block_17, IN[1]=code_block_14, IN[2]=list_create_10, IN[3]=code_block_24)  # CPython3
# ---------- calculation.python (415 lines) ----------
# Load the Python Standard and DesignScript Libraries
import sys
import clr
clr.AddReference('ProtoGeometry')
from Autodesk.DesignScript.Geometry import *


################Module For Functional Programing#########################
from functools import reduce
from itertools import chain
from itertools import groupby
from copy import deepcopy

curry = lambda f: lambda a, *args: (
    f(a, *args) if (len(args)) else lambda *args: f(a, *args)
)

filter, map, reduce = curry(filter), curry(map), curry(reduce)

go = lambda *args: reduce(lambda a, f: f(a), args)  ## 함수도 축약 가능 ##


def dictUpdate(dic1, dic2):
    dic1.update(dic2)
    return dic1


def dictsMerge(dics):
    res = reduce(dictUpdate, dics)
    return res


def dictDeleteKeys(dic, keys):
    for k in keys:
        del dic[k]
    return dic


def flat(a):
    if isinstance(a, list):
        for i in a:
            yield from flat(i)
    else:
        yield a


def grpBy(iter, key):
    f, grpKeys, grps = key, [], []
    sorted_ = sorted(iter, key=f)
    for key, grp_data in groupby(sorted_, key=f):
        grpKeys.append(key)
        grps.append(list(grp_data))
    return grps, grpKeys


#########################################################################
import json

def load_from_json(_file_path=None):
    # 파일 열기 위치 선택
    if _file_path:
        file_path = _file_path

    # JSON 파일에서 데이터 로드
    try:
        with open(file_path, "r", encoding="utf-8") as file:
            loaded_data = json.load(file)

        print(f"Data successfully loaded from {file_path}\n")
        return loaded_data
    except Exception as e:
        print(f"Error loading data from JSON: {e}\n")
        return False

def save_to_json_teamStdInfo(file_path, data):
    # 상태 객체에서 데이터를 저장
    try:
        with open(file_path, "w", encoding="utf-8") as file:
            json.dump(data, file, indent=4, ensure_ascii=False)
            # json.dump(state.project_info, file, indent=4, ensure_ascii=False)
        print(f"Data successfully saved to {file_path}")
    except Exception as e:
        print(f"Error saving data to JSON: {e}")

# The inputs to this node will be stored as a list in the IN variables.
dataEnteringNode = IN
building_name = IN[0]
bnote_path = IN[1]
bnote_data = deepcopy( load_from_json(_file_path=bnote_path) )
all_elemNames, all_elems = IN[2]
category_names = IN[3]


# Place your code below this line

bnote_revitTypes_inBuilding = go(
    bnote_data["project-assigntype"]["children"],
    filter(lambda x: list(x["values"])[1]==building_name),
    list,
)

bnote_revitType_names_inBuilding = go(
    bnote_revitTypes_inBuilding,
    map(lambda x: x["name"]),
    list,
)

all_eff_elems = go(
    zip(all_elemNames, all_elems),
    filter(lambda x: x[0] in bnote_revitType_names_inBuilding),
    map(lambda x: \
        {
            "name": x[0],
            "elem": x[1],
        }
    ),
    list,
)

#def get_param_value(elem, name):
#    if name not in list(map(lambda x: x.Name, elem.Parameters)):
#        calc_v = elem.ElementType.GetParameterValueByName(name)
#    elif name == "H_Room H or CH":
#        if elem.GetParameterValueByName(name)=="":
#            calc_v = elem.GetParameterValueByName("Unbounded Height")
#        else:
#            calc_v = elem.GetParameterValueByName(name)
#    else:
#        calc_v = elem.GetParameterValueByName(name)
#    
#    if calc_v=="":
#        calc_v = 0
#    
#    return calc_v
    
def get_param_value(elem, param_unit_str):
    unit = None
    if len(param_unit_str.split("|")) > 1:
        name, unit = go(
            param_unit_str.split("|"),
            map(lambda x: x.strip()),
            list,
        )
    else:
        name = param_unit_str.strip()
    
    if name not in list(map(lambda x: x.Name, elem.Parameters)):
        calc_v = elem.ElementType.GetParameterValueByName(name)
    elif name == "H_Room H or CH":
        if elem.GetParameterValueByName(name)=="":
            calc_v = elem.GetParameterValueByName("Unbounded Height")
        else:
            calc_v = elem.GetParameterValueByName(name)
    else:
        calc_v = elem.GetParameterValueByName(name)
    
    if calc_v=="":
        calc_v = 0
    
    if unit:
        res = calc_v / float(unit)
    else:
        res = calc_v
    
    return res

def calc_elem(elem_dic):
    def check_Str(_str):
        try:
            float(_str)
            return False
        except:
            return True
    
    elem = elem_dic["elem"]
    elem_dic.update(
        {
            "GUID": elem.GetParameterValueByName("IfcGUID"),
        }
    )
    
    tgt_bnoteType = go(
        bnote_revitTypes_inBuilding,
        filter( lambda x: x["name"]==elem_dic["name"] ),
        filter( lambda x: x["children"]!=[] ),
        list,
    )[0]
    
    stdType_no = tgt_bnoteType["values"][-1].split(" | ")[-1].strip()
    
    cat_no = str(stdType_no).split(".")[0]
    
    cat_name = go(
        category_names,
        filter( lambda x: x.startswith(cat_no) ),
        list,
    )[0]
    

    tgt_bnoteType_wmlist = go(
        list(list(tgt_bnoteType["children"])),
        list,
    )

    
    def calc_formula(formula, calc_param_list):
        #tmp_formula = formula
        try:
            tmp_formula = go(
                formula.split("\n"),
                filter(lambda x: "#" not in x),
                list,
            )[0]
        except:
            tmp_formula = ""
            
        if tmp_formula != "=Exca" and tmp_formula != "=Back" and tmp_formula != "=Disp":
            for n,v in calc_param_list:
                tmp_formula = tmp_formula.replace(n, str(v))
            try:
                calc_result = eval(tmp_formula.strip("=")), "계산 성공"
            except:
                calc_result = 0, "계산 실패 - 수식 혹은 파라미터가 유효하지 않음"
        else:
            tmp_formula = formula
            calc_result = 0, "토공 항목 - [H_PAB.RT.Q2A]_Revit 토공 물량 자동산출.dyn에서 산출 요망"
        
        #return formula, tmp_formula, *calc_result
        
        return {
            "수식": "'" + formula,
            "대입수식": "'" + tmp_formula,
            #"산출결과": calc_result[0],
            "산출결과": round(calc_result[0], 3),
            "산출로그": calc_result[1],
        }
        
    ## 헤더에 Note 추가 예정
    wm_dict_hdrs = [
        "분류", "표준타입", "상세분류", "wm", "gauge",
        "add_spec", "수식", "단위", "산출유형", "Note",
        ]
        
    wm_dicts = go(
        tgt_bnoteType_wmlist,
        deepcopy,
        map( lambda x: dict(zip(wm_dict_hdrs, x) ) ),
        list,
    )
    for wm_dict in wm_dicts:
        if "Note" not in wm_dict.keys():
            wm_dict.update(
                {"Note": ""}
            )
    
    
    tgt_bnoteType_wm_calcvalue = []
    for wm_dict in wm_dicts:
        calcType_no = wm_dict["산출유형"]
        print(calcType_no)
        calcdict = go(
            bnote_data["std-calcdict"]["children"],
            filter(lambda x: x["name"] == calcType_no),
            list,
        )[0]

        
        param_list = go(
            calcdict["children"],
            list,
            map(lambda x: x["values"]),
            list,
            map(lambda x: list(x)[1:]),
            lambda x: sorted(x, key=lambda x: len(str(x[0])), reverse=True),
            list,
        )

        calc_param_list = go(
            param_list,
            map( lambda x: [ x[0], get_param_value(elem, x[1])] if check_Str(x[1]) else [x[0], float(x[1]) ] ),
            list,
            lambda x: sorted(x, key=lambda x: len(str(x[0])), reverse=True),
        )


        wm_dict.update(
            calc_formula(wm_dict["수식"], calc_param_list)
        )
        wm_code = wm_dict["wm"].split("|")[0].strip()
        
        try:
            wm_desc = wm_dict["wm"].split(" | ")[7]
        except:
            wm_desc = ""
            
        wm_spec = go(
            wm_dict["wm"].split(" | ")[9:-4],
            filter( lambda x: not x.isnumeric() ),
            filter(lambda x: not ( ("(   )" in x) or ("(   )" in x) or ("(  )" in x)) ),
            lambda x: "\n".join(x),
        )
        
        wm_dict.update(
            {
                "wm_code": wm_code,
                "wm_desc": wm_desc,
                "wm_spec": wm_spec,
            }
        )
        tgt_bnoteType_wm_calcvalue.append(wm_dict)
    
    
    elem_dic.update(
        {
            "cat": cat_name,
            "stdType_no": stdType_no,
            "물량": tgt_bnoteType_wm_calcvalue,
        }
    )
    
    #return tgt_bnoteType_wm_calcvalue
    #return tgt_bnoteType
    return elem_dic


# Flatten the nested structure into a list of rows
def flatten_data(data):
    flat_data = []
    for dic in data:
        cat = dic["cat"]
        stdType_no = dic["stdType_no"]
        elem_name = dic["name"]
        #elem = dic["elem"]
        guid = dic["GUID"]
        for item in dic["물량"]:
            flat_data.append(
                [
                    cat,
                    stdType_no,
                    item["표준타입"],
                    item["분류"],
                    elem_name,
                    guid,
                    item["상세분류"],
                    item["wm_code"],
                    item["gauge"],
                    item["wm_desc"],
                    item["wm_spec"],
                    item["add_spec"],
                    item["수식"],
                    item["대입수식"],
                    item["산출결과"],
                    item["단위"],
                    item["산출유형"],
                    item["Note"],
                    item["산출로그"],
                ]
            )
    return flat_data


data = []
for e in all_eff_elems:
    try:
        data.append(calc_elem(e))
    except:
        data.append(
            {
                "cat": "-",
                "stdType_no": "-",
                "GUID": "-",
                "name": e["name"], 
                "물량": [{
                    "표준타입": "-",
                    "분류": "-",
                    "상세분류": "-",
                    "wm_code": "-",
                    "gauge": "-",
                    "wm_desc": "-",
                    "wm_spec": "-",
                    "add_spec": "-",
                    "수식": "-",
                    "대입수식": "-",
                    "산출결과": 0,
                    "단위": "-",
                    "산출유형": "-",
                    "Note": "",
                    "산출로그": "실패 - 레빗타입 WM등록 여부 확인필요",
                },]
            }
        )

flat_header = [
    "카테고리", "표준타입번호", "표준타입", "분류", "name", "GUID", "상세분류", 
    "wm_code", "gauge", "Description", "Spec.", 
    "Add_spec.", "수식", "대입수식", "산출결과", "단위", "산출유형", "Note",
    "산출로그",
    ]

flat_data = [flat_header]+flatten_data(data)

if not bnote_data.get("dynamo-calculation"):
    bnote_data.update( {"dynamo-calculation": {} } )

bnote_data["dynamo-calculation"].update( {building_name: flat_data} )



save_to_json_teamStdInfo(bnote_path, bnote_data)

# Assign your output to the OUT variable.
#OUT = calc_elem(all_eff_elems[195])

#OUT = data
OUT = bnote_data
# ----------------------------------------
exportToExcel = Data.ExportToExcel(filePath=make_excel_path, sheetName=code_block_15, startRow=code_block_16, startColumn=code_block_16, data=calculation)  # frozen
dynamo_calculation_항목이_확인된다면_b = Watch(calculation)  # "dynamo-calculation 항목이 확인된다면 B-note에서 리프레시 버튼을 누르세요."; graph output
code_block_25 = CodeBlock(i=calculation) { i["dynamo-calculation"]; }  # frozen
code_block_26 = CodeBlock(i=code_block_25) { i["PCB"]; }
code_block_27 = CodeBlock { 17; }
getItemAtIndex = List.GetItemAtIndex(list=code_block_26@L2, index=code_block_27)
code_block_28 = CodeBlock { 4; }
getItemAtIndex_2 = List.GetItemAtIndex(list=code_block_26@L2, index=code_block_28)
code_block_29 = CodeBlock(i=code_block_26) { i[108]; }
