# Dynamo graph ##_Bid_Finish Style Injector_1.1.0.dyn (Dynamo 2.16.1.2727)
# author: MK Jang
# Inject Finish Style Data in Building List into Revit Key Schedule

finish_category_선택 = CustomSelection("A_Floor Finish", items={A_Floor Finish: "0", B_Skirt Finish: "1", C_Wall Finish: "2", D_Ceiling Finish: "3", E_Wall Style: "4", F_Roof Style: "5", G_Door Style: "6", H_Window Style: "7"})  # graph input
code_block = CodeBlock(Finish_Category_Select=finish_category_선택) { Finish_Category_Select; }

# group: Filtering Finish Style Schedule
categories = Categories("OST_Schedules")
all_elements_of_category = ElementsOfCategory(Category=categories)
name = Element.Name(element=all_elements_of_category)
isfinishstyleschedule = Python(IN[0]=name)  # CPython3
# ---------- isfinishstyleschedule.python (45 lines) ----------
# Load the Python Standard and DesignScript Libraries
import sys
import clr
clr.AddReference('ProtoGeometry')
from Autodesk.DesignScript.Geometry import *

# The inputs to this node will be stored as a list in the IN variables.
dataEnteringNode = IN
sch_names_list = IN[0]
# Place your code below this line
tgtList = [
    "Floor Finish Style",
    "Base Finish Style",
    "Wall Finish Style",
    "Ceiling Finish Style",
    "Wall Style",
    "Roof Style",
    "Door Style",
    "Window Style",
    ]
tgtStr = "Style"

def isInStr_tgt(inStr,tgtStr):
    if tgtStr in inStr:
        res = True
    else:
        res = False
    return res

def isInStr_tgtList(inStr,tgtList):
    tmp = []
    for tgt in tgtList:
        if tgt in inStr:
            tmp.append(True)
        else:
            tmp.append(False)
    return any(tmp)
        

res = list(map(lambda x: isInStr_tgt(x, tgtStr) , sch_names_list))
    


# Assign your output to the OUT variable.
OUT = res
# ----------------------------------------
filterByBoolMask = List.FilterByBoolMask(list=all_elements_of_category, mask=isfinishstyleschedule)

name_2 = Element.Name(element=filterByBoolMask.in)
sortByKey = List.SortByKey(list=filterByBoolMask.in, keys=name_2)
getItemAtIdx = Python(IN[0]=code_block, IN[1]=sortByKey.sortedList)  # CPython3
# ---------- getItemAtIdx.python (20 lines) ----------
# Load the Python Standard and DesignScript Libraries
import sys
import clr
clr.AddReference('ProtoGeometry')
from Autodesk.DesignScript.Geometry import *

# The inputs to this node will be stored as a list in the IN variables.
dataEnteringNode = IN
idx = IN[0]
lists = IN[1]

# Place your code below this line
def getItemAtIdx(idx, col):
    if idx > 3:
        res = []
    else:
        res = col[idx]
    return res
# Assign your output to the OUT variable.
OUT = getItemAtIdx(idx, lists)
# ----------------------------------------

# group: Import From Excel
빌딩리스트_경로 = Filename("..\etc\_팀교육\팀표준 최종 검토\revit작업\플랜트건축팀_BIM_팀 표준마감_Building List_Rev.A_for 입찰Tool_2023.12.15_mk.xlsx")  # graph input
file_from_path = FileObject(path=빌딩리스트_경로)
code_block_2 = CodeBlock()
# ---------- code_block_2.designscript (7 lines) ----------
[
"Int Finish Style No"
,"Wall Style No"
,"Roof Style No"
,"Door Style No"
,"Window Style No"
];
# ----------------------------------------
boolean = BoolSelector(true)
importExcel = Data.ImportExcel(file=file_from_path, sheetName=code_block_2, showExcel=boolean)

code_block_3 = CodeBlock(i=importExcel) { i[0]; }
# note: 시트중 최 상위 Row Idx를  행의 첫번째 값 문자열이 ':'를 포함하는 지 검사하는 것으로 로직 대체
code_block_4 = CodeBlock { 5; }
code_block_5 = CodeBlock(x=code_block_4)
# ---------- code_block_5.designscript (6 lines) ----------
{
"Floor Finish": x,
"Skirt Finish": x,
"Wall Finish": x,
"Ceiling Finish": x
};
# ----------------------------------------
code_block_6 = CodeBlock { 0; ":"; }

# group: int Finish Style
parse_시트_as_dict__only_int = Python(IN[0]=code_block_3, IN[1]=code_block_5, IN[2]=code_block_6.out0, IN[3]=code_block_6.out1)  # CPython3
# ---------- parse_시트_as_dict__only_int.python (161 lines) ----------
# Load the Python Standard and DesignScript Libraries
import sys
import clr
clr.AddReference('ProtoGeometry')
from Autodesk.DesignScript.Geometry import *

from functools import partial
from itertools import chain

import re

#################################Module For Functional Programing#############################################
from functools import reduce
curry = lambda f: lambda a,*args: f(a, *args) if (len(args)) else lambda *args: f(a, *args)

filter = curry(filter)
map = curry(map)

def _take(length, iter):
    res = []
    for a in iter:
        res.append(a)
        if len(res) == length:
            return res
        
take = curry(_take)
reduce = curry(reduce)

go = lambda *args: reduce(lambda a,f: f(a), args) ## 함수도 축약 가능 ##
##############################################################################################################

# The inputs to this node will be stored as a list in the IN variables.
dataEnteringNode = IN
dataStartRowIdx = IN[2]
wholeDatas = IN[0]
sheet = wholeDatas[dataStartRowIdx:]
ignoreHdr_idxDic = IN[1]

catSepRuleChar = IN[3]

# Place your code below this line

def find_IsInStr(target, str):
    if target == None or str == None:
        pass
    else:
        res = target in str
        return res

def find_IsIn_list(target, lst):
    if target == None or str == None:
        pass
    else:
        res = target in lst
        return res

def find_range_by_columnItem(db, col_idx, sep_rule):
    tdb = list(map(lambda x: x[col_idx], db))
    last_idx_tdb = len(tdb)-1
    tdb_enum = enumerate(tdb)
    res = list(filter(lambda x: find_IsInStr(sep_rule, x[1]), tdb_enum))
    endidxs_tmp= list(map(lambda x: x[0]-1,res))
    endidxs_tmp.pop(0)
    endidxs = endidxs_tmp + [last_idx_tdb]

    DB_prime_Areas_Names = list(map(lambda x: x[1],res))
    DB_prime_Areas_Names_Idxs = list(map(lambda x: x[0],res))
    rangeSttIdxs = list(map(lambda x: x[0]+1,res))
    rangeEndIdxs = endidxs
    result = dict(zip(DB_prime_Areas_Names, zip(DB_prime_Areas_Names_Idxs, zip(rangeSttIdxs,rangeEndIdxs))))
    return result

def modify_DB_prime_Areas_Names(AIOdict, rule_Char):
    res = list(map(lambda x: x, AIOdict.items()))
    keys = list(map(lambda x: x[0].split(rule_Char)[0], res))
    vals = list(map(lambda x: x[1], res))
    return dict(zip(keys, vals))
    
    
def find_headersAtSheet(sheet):
    headers_sheet = map(lambda x: [x[1].replace("\n",""),x[0]], filter(lambda x: x[1] != None, enumerate(sheet[1])))
    
    return dict(headers_sheet)

def find_rangesAtSheet(sheet, hdrs_withIdx, trgt_hdr, trgt_str):
    return find_range_by_columnItem(sheet, hdrs_withIdx[trgt_hdr], trgt_str)

def find_rangesAtSheet_eq(sheet, hdrs_withIdx, trgt_hdr, row_sep_criteria):
    res = find_range_by_columnItem_Eq(sheet, hdrs_withIdx[trgt_hdr], row_sep_criteria)
    
    return res

def get_areaHeaders(areasDB):
    #res = list(filter(lambda x: '#' in x[1], areasDB))
    res = []
    for idx,v in enumerate(areasDB):
        if '#' in  str(v[1]):
            res.append([idx,v])
            #res = [idx,v]
    firstHdr = res[0]
    return firstHdr

def get_DBareas_ByRanges(db, ranges, ignoreHdr_idxDic):
    resDic = {}
    res = []
    for i in ranges.items():
        catName = i[0]
        rngs_sepRowIdx = i[1]
        rngs_stt = i[1][1][0]
        rngs_end = i[1][1][1]
        areaDB = db[rngs_stt:rngs_end+1]
        
        ignoreHdr_idx = ignoreHdr_idxDic[catName]
        hdrsRow = get_areaHeaders(areaDB)
        netHdrs = go\
        (
            hdrsRow[1],
            enumerate,
            filter(lambda x: x[0] != ignoreHdr_idx),
            list,
            map(lambda x: x[1]),
            filter(lambda x: x != '#'),
            filter(lambda x: x != None),
            list,
        )
        netHdrsIdx_inRow = list(map(lambda x: hdrsRow[1].index(x), netHdrs))
        
        p = re.compile('[A-Z]{1,3}\d{2}')
        stylNoIdx = go\
        (
            hdrsRow[1],
            filter(lambda x: "Style No" in str(x)),
            list,
            lambda x: x[0],
            lambda x: hdrsRow[1].index(x)
        )
        effRow = go\
        (
            areaDB[hdrsRow[0]+1:],
            filter(lambda x: p.match(str(x[stylNoIdx]))),
            list,
        )
        effAreaData = go\
        (
            effRow,
            map(lambda x: map(lambda y: x[y], netHdrsIdx_inRow)),
            map(lambda x: map(lambda y: "" if y == None else y, x)),
        )
        
        
        res.append(effAreaData)
    return res

ranges = modify_DB_prime_Areas_Names(find_range_by_columnItem(wholeDatas, 1, catSepRuleChar), catSepRuleChar)


res = get_DBareas_ByRanges(wholeDatas, ranges, ignoreHdr_idxDic)

# Assign your output to the OUT variable.

OUT = res
# ----------------------------------------

code_block_7 = CodeBlock(test=parse_시트_as_dict__only_int) { test; }
getItemAtIdx_2 = Python(IN[0]=code_block, IN[1]=code_block_7)  # CPython3; same code as getItemAtIdx
fields = ScheduleView.Fields(scheduleView=getItemAtIdx)

# group: key schedule
code_block_8 = CodeBlock(viewSchedule=getItemAtIdx) { _viewSchedule: var[]..[]; }
code_block_9 = CodeBlock(data=getItemAtIdx_2) { _data: var[]..[]; }
code_block_10 = CodeBlock(parameterNames=fields) { _parameterNames: var[]..[]; }
python_script = Python(IN[0]=code_block_8, IN[1]=code_block_9, IN[2]=code_block_10)  # CPython3
# ---------- python_script.python (69 lines) ----------
#Copyright(c) 2015, Konrad Sobon
# @arch_laboratory, http://archi-lab.net

import clr
clr.AddReference('ProtoGeometry')
from Autodesk.DesignScript.Geometry import *

# Import DocumentManager and TransactionManager
clr.AddReference("RevitServices")
import RevitServices
from RevitServices.Persistence import DocumentManager
from RevitServices.Transactions import TransactionManager

# Import RevitAPI
clr.AddReference("RevitAPI")
import Autodesk
from Autodesk.Revit.DB import *

doc = DocumentManager.Instance.CurrentDBDocument
uiapp = DocumentManager.Instance.CurrentUIApplication
app = uiapp.Application

from System.Collections.Generic import *

# Import ToDSType(bool) extension method
clr.AddReference("RevitNodes")
import Revit
clr.ImportExtensions(Revit.Elements)

#The inputs to this node will be stored as a list in the IN variable.
dataEnteringNode = IN

keySchedule = UnwrapElement(IN[0])
data = IN[1]
inputParams = IN[2]

# "Start" the transaction
TransactionManager.Instance.EnsureInTransaction(doc)

test = []
count = []
cellParams = [[] for i in range(len(data))]
if any(isinstance(item, list) for item in data):
	# process list of lists
	for i in data:
		count.append(len(i))
	colCount = max(count)
	colAvailable = len(keySchedule.Definition.GetSchedulableFields())
	if colCount > colAvailable:
		message = "Please add/remove parameters to/from schedule so that they match longest data set."
	else:
		tableData = keySchedule.GetTableData()
		sectionData = tableData.GetSectionData(SectionType.Body)
		if sectionData.NumberOfRows - 2 <= len(data):
			# schedule by default will have 2 rows (A, B, C and Header Names)
			rowsToAdd = (len(data) - sectionData.NumberOfRows) + 2
			for i in range(0, rowsToAdd, 1):
				sectionData.InsertRow(0)
		else:
			# schedule when updating might already have too many rows 
			rowsToDelete = sectionData.NumberOfRows - 2 - len(data)
			for i in reversed(range(sectionData.NumberOfRows - rowsToDelete, sectionData.NumberOfRows, 1)):
				sectionData.RemoveRow(i)

# "End" the transaction
TransactionManager.Instance.TransactionTaskDone()

#Assign your output to the OUT variable
OUT = keySchedule
# ----------------------------------------
code_block_11 = CodeBlock { _upperCase: bool = false; }
python_script_2 = Python(IN[0]=python_script, IN[1]=code_block_9, IN[2]=code_block_10, IN[3]=code_block_11)  # CPython3
# ---------- python_script_2.python (97 lines) ----------
#Copyright(c) 2015, Konrad Sobon
# @arch_laboratory, http://archi-lab.net

import clr
import sys
clr.AddReference('ProtoGeometry')
from Autodesk.DesignScript.Geometry import *

# Import DocumentManager and TransactionManager
clr.AddReference("RevitServices")
import RevitServices
from RevitServices.Persistence import DocumentManager
from RevitServices.Transactions import TransactionManager

# Import RevitAPI
clr.AddReference("RevitAPI")
import Autodesk
from Autodesk.Revit.DB import *

doc = DocumentManager.Instance.CurrentDBDocument
uiapp = DocumentManager.Instance.CurrentUIApplication
app = uiapp.Application

from System.Collections.Generic import *

# Import ToDSType(bool) extension method
clr.AddReference("RevitNodes")
import Revit
clr.ImportExtensions(Revit.Elements)

#pyt_path = r'C:\Program Files (x86)\IronPython 2.7\Lib'
#sys.path.append(pyt_path)
import re

#The inputs to this node will be stored as a list in the IN variable.
dataEnteringNode = IN

keySchedule = UnwrapElement(IN[0])
data = IN[1]
inputParams = IN[2]
upper = IN[3]

def set_keySchedule(keySchedule, data, inputParams, upper):
    # "Start" the transaction
    TransactionManager.Instance.EnsureInTransaction(doc)
    
    tableData = keySchedule.GetTableData()
    sectionData = tableData.GetSectionData(SectionType.Body)
    
    keyNames = []
    for i in range(1,sectionData.NumberOfRows - 1,1):
    	keyNames.append(str(int(i)))
    
    allKeys = FilteredElementCollector(doc).WhereElementIsNotElementType()
    params = [[] for i in range(len(keyNames))]
    test = []
    for key in allKeys:
    	try:
    		if key.get_Parameter(BuiltInParameter.REF_TABLE_ELEM_NAME).AsString() in keyNames and key.OwnerViewId == keySchedule.Id:
    			indexValue = keyNames.index(key.get_Parameter(BuiltInParameter.REF_TABLE_ELEM_NAME).AsString())
    			for i in range(0, len(inputParams),1):
    				params[indexValue].extend(key.GetParameters(str(inputParams[i])))
    	except:
    		pass
    
    for i, j in zip(params, data):
    	for param, value in zip(i,j):
    		if isinstance(value, str):
    			#valueDecoded = value.decode('string_escape')
    			valueDecoded = value.encode('utf-8').decode('unicode-escape')
    		else:
    			if value == None:
    				valueDecoded = " "
    			else:
    				#valueDecoded = str(value).decode('string_escape')
    				valueDecoded = str(value).encode('utf-8').decode('unicode-escape')
    		if upper:
    			valueDecoded = valueDecoded.upper()
    			param.Set(valueDecoded)
    		else:
    			param.Set(valueDecoded)
    
    
    # "End" the transaction
    TransactionManager.Instance.TransactionTaskDone()
    #return keySchedule

def get_final_result(keySchedule, data, inputParams, upper):
    if keySchedule == []:
        res = []
    else:
        set_keySchedule(keySchedule, data, inputParams, upper)
        res = keySchedule
    return res

#Assign your output to the OUT variable
OUT = get_final_result(keySchedule, data, inputParams, upper)
# ----------------------------------------
code_block_12 = CodeBlock(viewSchedule=python_script_2) { _viewSchedule; }

code_block_13 = CodeBlock(Finish_Category_Select=finish_category_선택) { Finish_Category_Select-4; }

# group: Wall, Roof, Door, Window 엑셀데이터 파싱구간
code_block_14 = CodeBlock(i=importExcel) { i[1]; i[2]; i[3]; i[4]; }
code_block_15 = CodeBlock(wall=code_block_14.out0) { wall; }
code_block_16 = CodeBlock { 4; }
code_block_17 = CodeBlock(x=code_block_16)
# ---------- code_block_17.designscript (4 lines) ----------
{
"Exterior Wall": x,
"Interior Wall": x
};
# ----------------------------------------
code_block_18 = CodeBlock { 0; ":"; }
parse_시트_as_dict = Python(IN[0]=code_block_15, IN[1]=code_block_17, IN[2]=code_block_18.out0, IN[3]=code_block_18.out1)  # CPython3
# ---------- parse_시트_as_dict.python (161 lines) ----------
# Load the Python Standard and DesignScript Libraries
import sys
import clr
clr.AddReference('ProtoGeometry')
from Autodesk.DesignScript.Geometry import *

from functools import partial
from itertools import chain

import re

#################################Module For Functional Programing#############################################
from functools import reduce
curry = lambda f: lambda a,*args: f(a, *args) if (len(args)) else lambda *args: f(a, *args)

filter = curry(filter)
map = curry(map)

def _take(length, iter):
    res = []
    for a in iter:
        res.append(a)
        if len(res) == length:
            return res
        
take = curry(_take)
reduce = curry(reduce)

go = lambda *args: reduce(lambda a,f: f(a), args) ## 함수도 축약 가능 ##
##############################################################################################################

# The inputs to this node will be stored as a list in the IN variables.
dataEnteringNode = IN
dataStartRowIdx = IN[2]
wholeDatas = IN[0]
sheet = wholeDatas[dataStartRowIdx:]
ignoreHdr_idxDic = IN[1]

catSepRuleChar = IN[3]

# Place your code below this line

def find_IsInStr(target, str):
    if target == None or str == None:
        pass
    else:
        res = target in str
        return res

def find_IsIn_list(target, lst):
    if target == None or str == None:
        pass
    else:
        res = target in lst
        return res

def find_range_by_columnItem(db, col_idx, sep_rule):
    tdb = list(map(lambda x: x[col_idx], db))
    last_idx_tdb = len(tdb)-1
    tdb_enum = enumerate(tdb)
    res = list(filter(lambda x: find_IsInStr(sep_rule, x[1]), tdb_enum))
    endidxs_tmp= list(map(lambda x: x[0]-1,res))
    endidxs_tmp.pop(0)
    endidxs = endidxs_tmp + [last_idx_tdb]

    DB_prime_Areas_Names = list(map(lambda x: x[1],res))
    DB_prime_Areas_Names_Idxs = list(map(lambda x: x[0],res))
    rangeSttIdxs = list(map(lambda x: x[0]+1,res))
    rangeEndIdxs = endidxs
    result = dict(zip(DB_prime_Areas_Names, zip(DB_prime_Areas_Names_Idxs, zip(rangeSttIdxs,rangeEndIdxs))))
    return result

def modify_DB_prime_Areas_Names(AIOdict, rule_Char):
    res = list(map(lambda x: x, AIOdict.items()))
    keys = list(map(lambda x: x[0].split(rule_Char)[0], res))
    vals = list(map(lambda x: x[1], res))
    return dict(zip(keys, vals))
    
    
def find_headersAtSheet(sheet):
    headers_sheet = map(lambda x: [x[1].replace("\n",""),x[0]], filter(lambda x: x[1] != None, enumerate(sheet[1])))
    
    return dict(headers_sheet)

def find_rangesAtSheet(sheet, hdrs_withIdx, trgt_hdr, trgt_str):
    return find_range_by_columnItem(sheet, hdrs_withIdx[trgt_hdr], trgt_str)

def find_rangesAtSheet_eq(sheet, hdrs_withIdx, trgt_hdr, row_sep_criteria):
    res = find_range_by_columnItem_Eq(sheet, hdrs_withIdx[trgt_hdr], row_sep_criteria)
    
    return res

def get_areaHeaders(areasDB):
    #res = list(filter(lambda x: '#' in x[1], areasDB))
    res = []
    for idx,v in enumerate(areasDB):
        if '#' in  str(v[1]):
            res.append([idx,v])
            #res = [idx,v]
    firstHdr = res[0]
    return firstHdr

def get_DBareas_ByRanges(db, ranges, ignoreHdr_idxDic):
    resDic = {}
    res = []
    for i in ranges.items():
        catName = i[0]
        rngs_sepRowIdx = i[1]
        rngs_stt = i[1][1][0]
        rngs_end = i[1][1][1]
        areaDB = db[rngs_stt:rngs_end+1]
        
        ignoreHdr_idx = ignoreHdr_idxDic[catName]
        hdrsRow = get_areaHeaders(areaDB)
        netHdrs = go\
        (
            hdrsRow[1],
            enumerate,
            filter(lambda x: x[0] != ignoreHdr_idx),
            list,
            map(lambda x: x[1]),
            filter(lambda x: x != '#'),
            filter(lambda x: x != None),
            list,
        )
        netHdrsIdx_inRow = list(map(lambda x: hdrsRow[1].index(x), netHdrs))
        
        p = re.compile('[A-Z]{1,3}\d{2}')
        stylNoIdx = go\
        (
            hdrsRow[1],
            filter(lambda x: "Style No" in str(x)),
            list,
            lambda x: x[0],
            lambda x: hdrsRow[1].index(x)
        )
        effRow = go\
        (
            areaDB[hdrsRow[0]+1:],
            filter(lambda x: p.match(str(x[stylNoIdx]))),
            list,
        )
        effAreaData = go\
        (
            effRow,
            map(lambda x: map(lambda y: x[y], netHdrsIdx_inRow)),
            map(lambda x: map(lambda y: "" if y == None else y, x)),
        )
        
        
        #res.append(effAreaData)
        resDic['_'.join(['0',catName])] = effAreaData
    return netHdrs, resDic

ranges = modify_DB_prime_Areas_Names(find_range_by_columnItem(wholeDatas, 1, catSepRuleChar), catSepRuleChar)

res = get_DBareas_ByRanges(wholeDatas, ranges, ignoreHdr_idxDic)

# Assign your output to the OUT variable.

OUT = res
# ----------------------------------------
code_block_19 = CodeBlock(roof=code_block_14.out1) { roof; }
code_block_20 = CodeBlock { 4; }
code_block_21 = CodeBlock(x=code_block_20)
# ---------- code_block_21.designscript (4 lines) ----------
{
"Concrete Roof": x,
"Cladding Roof": x
};
# ----------------------------------------
code_block_22 = CodeBlock { 0; ":"; }
parse_시트_as_dict_2 = Python(IN[0]=code_block_19, IN[1]=code_block_21, IN[2]=code_block_22.out0, IN[3]=code_block_22.out1)  # CPython3; same code as parse_시트_as_dict
code_block_23 = CodeBlock(door=code_block_14.out2) { door; }
code_block_24 = CodeBlock { 4; }
code_block_25 = CodeBlock(x=code_block_24)
# ---------- code_block_25.designscript (6 lines) ----------
{
"Single Door": x,
"Double Door": x,
"Double Door + Transsom": x,
"Shutter / Sliding / Hanger / Swing / Revolving / Folding": x
};
# ----------------------------------------
code_block_26 = CodeBlock { 0; ":"; }
parse_시트_as_dict_3 = Python(IN[0]=code_block_23, IN[1]=code_block_25, IN[2]=code_block_26.out0, IN[3]=code_block_26.out1)  # CPython3; same code as parse_시트_as_dict
code_block_27 = CodeBlock(window=code_block_14.out3) { window; }
code_block_28 = CodeBlock { 4; }
code_block_29 = CodeBlock(x=code_block_28)
# ---------- code_block_29.designscript (9 lines) ----------
{
"Sliding Type": x,
"Awning Type": x,
"Fix Type": x,
"Combination Type": x,
"Skylight": x,
"MISC": x,
"Louver": x
};
# ----------------------------------------
code_block_30 = CodeBlock { 0; ":"; }
parse_시트_as_dict_4 = Python(IN[0]=code_block_27, IN[1]=code_block_29, IN[2]=code_block_30.out0, IN[3]=code_block_30.out1)  # CPython3; same code as parse_시트_as_dict

list_create = List.Create(item0=parse_시트_as_dict, item1=parse_시트_as_dict_2, item2=parse_시트_as_dict_3, item3=parse_시트_as_dict_4)
getItemAtIdx_3 = Python(IN[0]=code_block_13, IN[1]=list_create)  # CPython3
# ---------- getItemAtIdx_3.python (20 lines) ----------
# Load the Python Standard and DesignScript Libraries
import sys
import clr
clr.AddReference('ProtoGeometry')
from Autodesk.DesignScript.Geometry import *

# The inputs to this node will be stored as a list in the IN variables.
dataEnteringNode = IN
idx = IN[0]
lists = IN[1]

# Place your code below this line
def getItemAtIdx(idx, col):
    if idx < 0:
        res = [[],[]]
    else:
        res = col[idx]
    return res
# Assign your output to the OUT variable.
OUT = getItemAtIdx(idx, lists)
# ----------------------------------------
code_block_31 = CodeBlock(input=getItemAtIdx_3) { input; }
duplicate_familyTypes = Python(IN[0]=code_block_13, IN[1]=code_block_31)  # CPython3
# ---------- duplicate_familyTypes.python (122 lines) ----------
# Load the Python Standard and DesignScript Libraries
import sys
import clr
clr.AddReference('ProtoGeometry')
from Autodesk.DesignScript.Geometry import *

from functools import partial
from itertools import chain

import re

clr.AddReference('RevitAPI')
from Autodesk.Revit.DB import *
import Autodesk

clr.AddReference('RevitServices')
import RevitServices
from RevitServices.Persistence import DocumentManager
from RevitServices.Transactions import TransactionManager as t
doc = DocumentManager.Instance.CurrentDBDocument
#collector = FilteredElementCollector(doc)

#################################Module For Functional Programing#############################################
from functools import reduce
curry = lambda f: lambda a,*args: f(a, *args) if (len(args)) else lambda *args: f(a, *args)

filter = curry(filter)
map = curry(map)

def _take(length, iter):
    res = []
    for a in iter:
        res.append(a)
        if len(res) == length:
            return res
        
take = curry(_take)
reduce = curry(reduce)

go = lambda *args: reduce(lambda a,f: f(a), args) ## 함수도 축약 가능 ##
##############################################################################################################

# The inputs to this node will be stored as a list in the IN variables.
dataEnteringNode = IN
catSelectionIDX = IN[0]
wholeDatas = IN[1]
CatRowsDic = IN[1][1]

# Place your code below this line

def get_familyTypeName(row):
    res = "_".join(["B",row[0],row[1]])
    return res

def get_familyTypeNamesPerCat(CatRowsDic):
    res = []
    resDic = {}
    for name,rows in CatRowsDic.items():
        protoTypeFamName = name
        tmp = go\
        (
            rows,
            map(get_familyTypeName),
            list,
        )
        #res.append(tmp)
        resDic[protoTypeFamName] = tmp
    return resDic

def duplicate_famTypeByName(cat,CatRowsDic):
    resDic = {}
    bics = {
        "Wall": lambda x: x.OfCategory(BuiltInCategory.OST_Walls),
        "Roof": lambda x: x.OfCategory(BuiltInCategory.OST_Roofs),
        "Door": lambda x: x.OfCategory(BuiltInCategory.OST_Doors),
        "Window": lambda x: x.OfCategory(BuiltInCategory.OST_Windows),
    }
    collector = FilteredElementCollector(doc)
    all_Types_name = go\
    (
        collector,
        bics[cat],
        lambda x: x.WhereElementIsElementType(),
        lambda x: x.ToElements(),
        list
    )
    select_eff_Types = lambda typeName: go\
    (
        collector,
        bics[cat],
        lambda x: x.WhereElementIsElementType(),
        lambda x: x.ToElements(),
        filter(lambda x: x.get_Name()==typeName),
        list
    )
    for name,rows in CatRowsDic.items():
        eff_type = select_eff_Types(name)[0]
        newRow = []
        for row in rows:
            if row in all_Types_name:
                newRow.append(select_eff_Types(row))
            else:
                t.Instance.EnsureInTransaction(doc)
                newRow.append(eff_type.Duplicate(row))
                t.Instance.TransactionTaskDone()
        resDic[name] = newRow
    return resDic
#name_modified_Dic = get_familyTypeNamesPerCat(CatRowsDic)
#res = duplicate_famTypeByName("Roof", name_modified_Dic)

def get_final_result(catSelectionIDX,CatRowsDic):
    if catSelectionIDX < 0:
        res = []
    else:
        catTypes = ["Wall","Roof","Door","Window"][catSelectionIDX]
        name_modified_Dic = get_familyTypeNamesPerCat(CatRowsDic)
        res = duplicate_famTypeByName(catTypes, name_modified_Dic)
    return res
# Assign your output to the OUT variable.


OUT = get_final_result(catSelectionIDX,CatRowsDic)
# ----------------------------------------
deconstruct = List.Deconstruct(list=code_block_31)
firstItem = List.FirstItem(list=deconstruct.rest)
setParameter_familyTypes = Python(IN[0]=duplicate_familyTypes, IN[1]=deconstruct.first, IN[2]=firstItem)  # CPython3
# ---------- setParameter_familyTypes.python (80 lines) ----------
# Load the Python Standard and DesignScript Libraries
import sys
import clr
clr.AddReference('ProtoGeometry')
from Autodesk.DesignScript.Geometry import *

from functools import partial
from itertools import chain

import re

clr.AddReference('RevitAPI')
from Autodesk.Revit.DB import *
import Autodesk

clr.AddReference('RevitServices')
import RevitServices
from RevitServices.Persistence import DocumentManager
from RevitServices.Transactions import TransactionManager as t
doc = DocumentManager.Instance.CurrentDBDocument
#collector = FilteredElementCollector(doc)

#################################Module For Functional Programing#############################################
from functools import reduce
curry = lambda f: lambda a,*args: f(a, *args) if (len(args)) else lambda *args: f(a, *args)

filter = curry(filter)
map = curry(map)

def _take(length, iter):
    res = []
    for a in iter:
        res.append(a)
        if len(res) == length:
            return res
        
take = curry(_take)
reduce = curry(reduce)

go = lambda *args: reduce(lambda a,f: f(a), args) ## 함수도 축약 가능 ##
##############################################################################################################

# The inputs to this node will be stored as a list in the IN variables.
dataEnteringNode = IN
eTypesPerCat = IN[0]
paramNames = IN[1]
paramValuesPerCat = IN[2]

# Place your code below this line

def get_familyTypeName(row):
    res = "_".join([row[0],row[1]])
    return res

def setParam_familyTypePerCat(eTypesPerCat, paramNames, paramValuesPerCat):
    res = []
    resDic = {}
    names = eTypesPerCat.keys()
    for name in names:
        eTypes = eTypesPerCat[name]
        paramValuesPerElem = paramValuesPerCat[name]
        t.Instance.TransactionTaskDone()
        for idx,val in enumerate(eTypes):
            pVals = paramValuesPerElem[idx]
            paramNamesModified = list(map(lambda x: '_'.join(['H',x]),paramNames))
            for iidx, pName in enumerate(paramNamesModified):
                val.SetParameterByName(pName, pVals[iidx])
        t.Instance.TransactionTaskDone()
    return names

def get_final_result(eTypesPerCat,paramNames,paramValuesPerCat):
    if eTypesPerCat == []:
        res = []
    else:
        res = setParam_familyTypePerCat(eTypesPerCat, paramNames, paramValuesPerCat)
    return res

# Assign your output to the OUT variable.

OUT = get_final_result(eTypesPerCat,paramNames,paramValuesPerCat)
# ----------------------------------------
result = List.Create(item0=code_block_12, item1=setParameter_familyTypes)  # graph output
