# Dynamo graph [H_PAB.RT.Q2A]_Revit 토공 물량 산출_[3.0.0]_debug.dyn (Dynamo 2.16.1.2727)
# author: MK Jang
# Auto Calculating the Quantities of each Element As per the Family List

building_name = CodeBlock { bdName; }  # unwired: bdName

# group: HTML 부재별 물량 기입 구간
javascriptPart = Python()  # CPython3; unwired: IN[0], IN[1], IN[2]
# ---------- javascriptPart.python (59 lines) ----------
# Load the Python Standard and DesignScript Libraries
import sys
import clr
clr.AddReference('ProtoGeometry')
from Autodesk.DesignScript.Geometry import *

# The inputs to this node will be stored as a list in the IN variables.
dataEnteringNode = IN

# Place your code below this line
jsPart = '''
function hideAllPages() {
        document.querySelector("#home").style.fontWeight = "normal";
        document.querySelector("#homePage").style.display = "None";
        document.querySelector("#info").style.fontWeight = "normal";
        document.querySelector("#infoPage").style.display = "None";
        document.querySelector("#famType").style.fontWeight = "normal";
        document.querySelector("#famTypePage").style.display = "None";
        document.querySelector("#roomInfo").style.fontWeight = "normal";
        document.querySelector("#roomInfoPage").style.display = "None";
        document.querySelector("#roomInfoPage_chk").style.display = "None";
}

document.querySelector("#cat").onclick = function() {
	    let img = document.createElement("img");
	    img.setAttribute("src", "https://t4.ftcdn.net/jpg/05/62/99/31/360_F_562993122_e7pGkeY8yMfXJcRmclsoIjtOoVDDgIlh.jpg");
	    document.querySelector("#cat").style.display = "None";
	    img.setAttribute("style", "width:300px;margin-top:20px;")
	    document.body.append(img);
	};
document.querySelector("#home").onclick = function() {
        hideAllPages();
        document.querySelector("#home").style.fontWeight = "bolder";
        document.querySelector("#homePage").style.display = "inline";
	};
document.querySelector("#info").onclick = function() {
        hideAllPages();
        document.querySelector("#info").style.fontWeight = "bolder";
        document.querySelector("#infoPage").style.display = "inline";
	};
document.querySelector("#famType").onclick = function() {
        hideAllPages();
        document.querySelector("#famType").style.fontWeight = "bolder";
        document.querySelector("#famTypePage").style.display = "inline";
	};
document.querySelector("#roomInfo").onclick = function() {
        hideAllPages();
        document.querySelector("#roomInfo").style.fontWeight = "bolder";
        document.querySelector("#roomInfoPage").style.display = "inline";
	};
document.querySelector("#roomInfo_chk").onclick = function() {
        hideAllPages();
        document.querySelector("#roomInfo_chk").style.fontWeight = "bolder";
        document.querySelector("#roomInfoPage_chk").style.display = "inline";
	};
	
'''
# Assign your output to the OUT variable.
OUT = jsPart
# ----------------------------------------
cssPart = Python()  # CPython3; unwired: IN[0], IN[1], IN[2]
# ---------- cssPart.python (125 lines) ----------
# Load the Python Standard and DesignScript Libraries
import sys
import clr
clr.AddReference('ProtoGeometry')
from Autodesk.DesignScript.Geometry import *

# The inputs to this node will be stored as a list in the IN variables.
dataEnteringNode = IN

# Place your code below this line
cssPart = '''

/* style.css */
img {
 width : 25%;
 height: 25%; 
}

:root {
  --text-color: #f0f4f5;
  --background-color: #263343;
  --accent-color: orange;
  --icons-color: rgb(152, 187, 201);
  --bodybackground-color: lightgray;
}

th {
  text-align: center;
  padding-left: 30px;
}

td {
  padding-left: 40px;
  border-bottom : 1px solid gray;
  border-collapse : collapse;
}

body {
  margin: 0;
  background-color: var(--bodybackground-color);
  font-family: 'STIX Two Math';
} 

a {
  text-decoration: none;
  color: var(--text-color);
}

.navbar {
  display: flex;
  position: sticky;
  top: 0px; /* 도달했을때 고정시킬 위치 */
  justify-content: space-between;
  align-items: center;
  background-color: var(--background-color);
  padding: 8px 12px;
  font-family: 'STIX Two Math';
}

.navbar__logo i {
  color: var(--accent-color);
  padding-left: 0;
}

.navbar__menu {
  list-style: none;
  display: flex;
  margin: 0;
  padding-left: 0;
}

.navbar__menu li {
  padding: 8px 30px;
  color: var(--text-color);
}

.navbar__menu li:hover {
  background-color: var(--accent-color);
  border-radius: 3px;
}

.navbar__icons {
  list-style: none;
  display: flex;
  color: var(--icons-color);
  margin: 0;
  padding-left: 0;
}

.navbar__icons li {
  padding: 8px 12px;
  margin: 0;
}

#cat {
  display: block;
  }

#home {
  font-weight: bolder;
  }

#homePage {
  display: inline;
  }

#infoPage {
  display: None;
  }

#famTypePage {
  display: None;
  }

#roomInfoPage {
  display: None;
  }

#roomInfoPage_chk {
  display: None;
  }

'''
# Assign your output to the OUT variable.
OUT = cssPart
# ----------------------------------------
navHTML_Part = Python()  # CPython3; unwired: IN[0]
# ---------- navHTML_Part.python (24 lines) ----------
# Load the Python Standard and DesignScript Libraries
import sys
import clr
clr.AddReference('ProtoGeometry')
from Autodesk.DesignScript.Geometry import *

# The inputs to this node will be stored as a list in the IN variables.
dataEnteringNode = IN

# Place your code below this line
navPart = f"""

<nav class="navbar">

  <ul class="navbar__menu">
    <li id="home">Home</li>
  </ul>

</nav>

"""

# Assign your output to the OUT variable.
OUT = navPart
# ----------------------------------------
list_create = List.Create()  # unwired: item0
make_htmlStr = Python(IN[0]=javascriptPart, IN[1]=cssPart, IN[2]=navHTML_Part, IN[3]=building_name, IN[4]=list_create)  # CPython3; frozen
# ---------- make_htmlStr.python (59 lines) ----------
# Load the Python Standard and DesignScript Libraries
import sys
import clr
clr.AddReference('ProtoGeometry')
from Autodesk.DesignScript.Geometry import *

# The inputs to this node will be stored as a list in the IN variables.
dataEnteringNode = IN
jsPart = IN[0]
cssPart = IN[1]
navPart = IN[2]

pjtName = IN[3][0]
bdName = IN[3][1]
pages = IN[4]

homePage = pages[0]



# Place your code below this line
##folderPath_r = folderPath.replace('\\','\\\\')

htmlStr = f'''
<!DOCTYPE html>
<html lang="ko">

<head>
    <link rel="shortcut icon" href="#">
    <meta charset="UTF-8">
    <title>RVT Calculation Result</title>
    <style>
        {cssPart}
    </style>
</head>

<header>
<h5>Revit Elements' Bill of Quantities Page</h5>
<h4>{pjtName}</h4>
<h4>{bdName}</h4>
</header>

<body>
{navPart}

<div id="homePage">
{homePage}
</div>



<script type ="module" src="./js/script.js"></script>

</body>

</html>
'''
# Assign your output to the OUT variable.
OUT = htmlStr
# ----------------------------------------
code_block = CodeBlock(htmlStr=make_htmlStr) { htmlStr; }
serverFilePath = CodeBlock { ".dynTemp"; }
htmlPath = Python(IN[0]=serverFilePath)  # CPython3
# ---------- htmlPath.python (35 lines) ----------
# Load the Python Standard and DesignScript Libraries
import sys
import clr
clr.AddReference('ProtoGeometry')
from Autodesk.DesignScript.Geometry import *
import time
import subprocess
import os

clr.AddReference('RevitNodes')
import Revit
clr.ImportExtensions(Revit.Elements)
from Revit import Elements
# The inputs to this node will be stored as a list in the IN variables.
dataEnteringNode = IN
dynTempServerPath = IN[0]
# Place your code below this line
def find_cwd():
    doc = Revit.Application.Document.Current
    filePath_string = doc.FilePath
    folderPath = filePath_string.split('\\')
    folderPath.pop(-1)
    folderPath_str = '\\'.join(folderPath)
    return folderPath_str

cwd = find_cwd()
#cwd = os.getenv("HomePath")

folderPath = f"{cwd}\\{dynTempServerPath}\\tmpForBOQ"
if not os.path.exists(folderPath):
    os.makedirs(folderPath)

# Assign your output to the OUT variable.
#OUT = "C:"+folderPath
OUT = folderPath
# ----------------------------------------
n0_set_port_number_기본값_8000_작동_오류 = StringInput("8000")  # "0. Set Port Number: 기본값-8000 (작동 오류 없다면 변경 금지)"; graph input
create_html_file_and_open = Python(IN[0]=code_block, IN[1]=htmlPath, IN[2]=n0_set_port_number_기본값_8000_작동_오류)  # CPython3
# ---------- create_html_file_and_open.python (85 lines) ----------
# Load the Python Standard and DesignScript Libraries
import os
import sys
import clr
clr.AddReference('ProtoGeometry')
from Autodesk.DesignScript.Geometry import *

clr.AddReference('RevitNodes')
import Revit
clr.ImportExtensions(Revit.Elements)
from Revit import Elements

import time
import subprocess
import asyncio
import multiprocessing

#################################Module For Functional Programing#############################################
from functools import reduce
curry = lambda f: lambda a,*args: f(a, *args) if (len(args)) else lambda *args: f(a, *args)

filter = curry(filter)
map = curry(map)

def _take(length, iter):
    res = []
    for a in iter:
        res.append(a)
        if len(res) == length:
            return res
        
take = curry(_take)
reduce = curry(reduce)

go = lambda *args: reduce(lambda a,f: f(a), args) ## 함수도 축약 가능 ##
##############################################################################################################

# The inputs to this node will be stored as a list in the IN variables.
dataEnteringNode = IN
contents = IN[0]
folderPath = IN[1]
cwd = folderPath
portNo = IN[2]
#bdName = IN[2]
# Place your code below this line

def find_cwd():
    doc = Revit.Application.Document.Current
    filePath_string = doc.FilePath
    folderPath = filePath_string.split('\\')
    folderPath.pop(-1)
    folderPath_str = '\\'.join(folderPath)
    return folderPath_str

def make_resultHTMLname(htmlStr,title,cwd):
    timeStamp = time.strftime('%H_%M_%S', time.localtime(time.time()))
    #folderPath = f"{cwd}\\.dynLog"
    folderPath = cwd
    if not os.path.exists(folderPath):
        os.makedirs(folderPath)
    fileName = f"index.html"
    filePath = f"{folderPath}\\" + fileName
    f = open(filePath, 'w', encoding='utf8')
    f.write(htmlStr)
    f.close()
    return fileName


def execute_browser(cwd):
    #cwd = find_cwd()
    folderPath = cwd
    os.chdir(folderPath)
    #cmdStr = "start chrome http:localhost:8000"
    cmdStr = f"start msedge http:localhost:{portNo}"
    cmdList= cmdStr.split(' ')
    #subprocess.run(args=[fileName], shell=True)
    #subprocess.run(args=['start','excel',fileName], shell=True)
    subprocess.run(args=cmdList, shell=True)
    return cmdList


fileName = make_resultHTMLname(contents,"test",cwd)

# Assign your output to the OUT variable.
OUT = execute_browser(cwd)#fileName.split('.')[0]
# ----------------------------------------
create_js_file = Python(IN[0]=javascriptPart, IN[1]=htmlPath)  # CPython3; unwired: IN[2]
# ---------- create_js_file.python (84 lines) ----------
# Load the Python Standard and DesignScript Libraries
import os
import sys
import clr
clr.AddReference('ProtoGeometry')
from Autodesk.DesignScript.Geometry import *

clr.AddReference('RevitNodes')
import Revit
clr.ImportExtensions(Revit.Elements)
from Revit import Elements

import time
import subprocess

#################################Module For Functional Programing#############################################
from functools import reduce
curry = lambda f: lambda a,*args: f(a, *args) if (len(args)) else lambda *args: f(a, *args)

filter = curry(filter)
map = curry(map)

def _take(length, iter):
    res = []
    for a in iter:
        res.append(a)
        if len(res) == length:
            return res
        
take = curry(_take)
reduce = curry(reduce)

go = lambda *args: reduce(lambda a,f: f(a), args) ## 함수도 축약 가능 ##
##############################################################################################################

# The inputs to this node will be stored as a list in the IN variables.
dataEnteringNode = IN
contents = IN[0]
folderPath = IN[1]
#bdName = IN[2]
# Place your code below this line
def find_cwd():
    doc = Revit.Application.Document.Current
    filePath_string = doc.FilePath
    folderPath = filePath_string.split('\\')
    folderPath.pop(-1)
    folderPath_str = '\\'.join(folderPath)
    return folderPath_str

#cwd = find_cwd()
cwd = folderPath

def make_resultHTMLname(jsStr,cwd):
    #timeStamp = time.strftime('%H_%M_%S', time.localtime(time.time()))
    #folderPath = f"{cwd}\\.dynLog"
    folderPath = cwd
    jsPath = cwd + "\\js"
    if not os.path.exists(folderPath):
        os.makedirs(folderPath)
    if not os.path.exists(jsPath):
        os.makedirs(jsPath)
    fileName = "script.js"
    filePath = f"{jsPath}\\" + fileName
    f = open(filePath, 'w', encoding='utf8')
    f.write(jsStr)
    f.close()
    return fileName

def execute_file(fileName):
    #cwd = find_cwd()
    folderPath = cwd
    os.chdir(folderPath)
    subprocess.run(args=[fileName], shell=True)
    #subprocess.run(args=['start','excel',fileName], shell=True)
    

fileName = make_resultHTMLname(contents,cwd)
#fileName = "Test1.html"

#execute_file(fileName)


# Assign your output to the OUT variable.
OUT = fileName
# ----------------------------------------
start_webserver = Python(IN[0]=htmlPath, IN[1]=n0_set_port_number_기본값_8000_작동_오류)  # CPython3
# ---------- start_webserver.python (48 lines) ----------
# Load the Python Standard and DesignScript Libraries
import sys
import clr
clr.AddReference('ProtoGeometry')
from Autodesk.DesignScript.Geometry import *

import os
import asyncio
import multiprocessing
import subprocess
# The inputs to this node will be stored as a list in the IN variables.
dataEnteringNode = IN
cwd = IN[0]
portNo = IN[1]
# Place your code below this line
batStr = f"""
@echo on
python -m http.server {portNo}
cmd /k
"""
##cmd /k
title = "localWebserver"

def make_startSever_bat(batStr,title,cwd):
    folderPath = cwd
    if not os.path.exists(folderPath):
        os.makedirs(folderPath)
    fileName = f"{title}.bat"
    filePath = f"{folderPath}\\" + fileName
    f = open(filePath, 'w', encoding='utf8')
    f.write(batStr)
    f.close()
    return fileName

def startBat(fileName, cwd):
    cmdStr = f".\\{fileName}"
    cmdList= cmdStr.split(' ')
    os.chdir(cwd)
    
    res = subprocess.Popen(args=cmdList, shell=True)
    return res

batFileName = make_startSever_bat(batStr,title,cwd)
#res = multiprocessing.Process(name="SubProcess", target=startBat, args=(batFileName, cwd))
# Assign your output to the OUT variable.
OUT = startBat(batFileName, cwd)

#startBat(fileName, cwd)
# ----------------------------------------
make_htmlStr_2 = Python(IN[0]=javascriptPart, IN[1]=cssPart)  # CPython3; unwired: IN[2]
# ---------- make_htmlStr_2.python (53 lines) ----------
# Load the Python Standard and DesignScript Libraries
import sys
import clr
clr.AddReference('ProtoGeometry')
from Autodesk.DesignScript.Geometry import *

# The inputs to this node will be stored as a list in the IN variables.
dataEnteringNode = IN
jsPart = IN[0]
cssPart = IN[1]
tablePart = IN[2]

# Place your code below this line
##folderPath_r = folderPath.replace('\\','\\\\')

htmlStr = f'''
<!DOCTYPE html>
<html lang="ko">

<head>
    <meta charset="UTF-8">
    <title>my first three.js app</title>
    <style>
        {cssPart}
    </style>
</head>

<body>


<div class="wrapper">

  <a data-fslightbox="gallery" href="#custom-source">
    유튜브 라이트박스
  </a>

  <iframe id="custom-source"
          frameborder="0"
          width="1920px"
          height="1080px"
          allow="autoplay; fullscreen"
          src="https://www.youtube.com/embed/qgBSiRwsbNw?autoplay=1">
  </iframe>
</div>

<script src="https://cdnjs.cloudflare.com/ajax/libs/fslightbox/3.3.1/index.min.js" integrity="sha512-EqNNJuepkw5P9vxCml8eBk7C4Ld+4kAnvzOD/jG21rkxWPILGoQa5EvD62UieiJF0u3xoQrcVnce4i83VnYj/Q==" crossorigin="anonymous" referrerpolicy="no-referrer"></script>

</body>

</html>
'''
# Assign your output to the OUT variable.
OUT = htmlStr
# ----------------------------------------

n0_1_select_gl = Levels("GL")  # "0.1. Select GL"
code_block_2 = CodeBlock { "Elevation"; }
getParameterValueByName = Element.GetParameterValueByName(element=n0_1_select_gl, parameterName=code_block_2)
parameters = Element.Parameters(element=n0_1_select_gl)
n4_total_boq_sheet_경로_입력 = Filename("..\etc\물량산출테스트용\debug\20240902_khh\Total BOQ_blank.xlsx")  # "4. Total BOQ sheet 경로 입력"

# group: All Data In Excel
n1_family_list_경로_입력 = Filename("..\..\..\Teams Received\(H_PAB.OD.L2)_BIM 팀 표준 패밀리 리스트_r4_남양주 DH room.xlsx")  # "1. Family List 경로 입력"
file_from_path = FileObject(path=n1_family_list_경로_입력)
target_sheet_names = CodeBlock()
# ---------- target_sheet_names.designscript (19 lines) ----------
[
"WM-AR"
,"산출기준"
,"0.Room"
,"1.Floors"
,"2.Roofs"
,"3.Walls_Ext"
,"3.Walls_Int"
,"4.St_Fdn"
,"5.St_Col"
,"6.St_Framing"
,"7.Ceilings"
,"8.Doors"
,"9.Windows"
,"10.Stairs"
,"11.Railings"
,"12.Generic"
,"13.Manual_Input"
];
# ----------------------------------------
boolean = BoolSelector(true)
importExcel = Data.ImportExcel(file=file_from_path, sheetName=target_sheet_names, showExcel=boolean)  # frozen

code_block_3 = CodeBlock(i=importExcel) { i[2..16]; }
code_block_4 = CodeBlock(i=importExcel) { i[16]; }

# group: All Elements in Revit
all_elementsexceptrails = Python()  # CPython3; unwired: IN[0]
# ---------- all_elementsexceptrails.python (51 lines) ----------
# Load the Python Standard and DesignScript Libraries
import sys
import clr
clr.AddReference('ProtoGeometry')
from Autodesk.DesignScript.Geometry import *

clr.AddReference('RevitAPI')
from Autodesk.Revit.DB import *
import Autodesk

clr.AddReference('RevitServices')
import RevitServices
from RevitServices.Persistence import DocumentManager
doc = DocumentManager.Instance.CurrentDBDocument

def get_all_BIC():

    db = [
    Autodesk.Revit.DB.BuiltInCategory.OST_Floors,
#    Autodesk.Revit.DB.BuiltInCategory.OST_Roofs,
    Autodesk.Revit.DB.BuiltInCategory.OST_Walls,
    Autodesk.Revit.DB.BuiltInCategory.OST_StructuralFoundation,
    Autodesk.Revit.DB.BuiltInCategory.OST_StructuralColumns,
    Autodesk.Revit.DB.BuiltInCategory.OST_StructuralFraming,
#    Autodesk.Revit.DB.BuiltInCategory.OST_Ceilings,
#    Autodesk.Revit.DB.BuiltInCategory.OST_Doors,
#    Autodesk.Revit.DB.BuiltInCategory.OST_Windows,
#    Autodesk.Revit.DB.BuiltInCategory.OST_Stairs,
    #Autodesk.Revit.DB.BuiltInCategory.OST_Railings,
    ]
    return db
    
def get_allElems(doc):
    bics = get_all_BIC()
    
    def getElems(x):
        collector = FilteredElementCollector(doc)
        res = collector.OfCategory(x).WhereElementIsNotElementType().ToElements()
        return res

    def getRailElems(x):
        collector = FilteredElementCollector(doc)
        res = collector.OfCategory(x).WhereElementIsNotElementType()
        return res

    res = map(getElems, bics)
#    res = getRailElems(Autodesk.Revit.DB.BuiltInCategory.OST_RailingSystemRail)
    return res


OUT = get_allElems(doc)
# ----------------------------------------
categories = Categories("OST_EdgeSlab")
all_elements_of_category = ElementsOfCategory(Category=categories)
list_create_2 = List.Create(item0=all_elements_of_category)
join = List.Join(list0=all_elementsexceptrails, list1=list_create_2)

flatten = List.Flatten(list=join)
n2_select_gl_point_gl과_높이가_일치하는 = CustomSelection("Survey Point", items={Survey Point: "Survey Point", Project Base Point: "Project Base Point"})  # "2. Select GL Point (GL과 높이가 일치하는 좌표기준점을 선택해주세요)"; graph input
n2_1_gl과_높이가_일치하는_포인트가_없다면_1_에서 = DoubleInput(0)  # "2.1. GL과 높이가 일치하는 포인트가 없다면 1.에서 선택한 Point 와 GL간의 레벨차를 입력해주세요.[ Point - GL ](mm)"; graph input
python_script = Python(IN[0]=n2_select_gl_point_gl과_높이가_일치하는, IN[1]=n2_1_gl과_높이가_일치하는_포인트가_없다면_1_에서)  # CPython3
# ---------- python_script.python (18 lines) ----------
# Load the Python Standard and DesignScript Libraries
import sys
import clr
clr.AddReference('ProtoGeometry')
from Autodesk.DesignScript.Geometry import *
import Revit

# The inputs to this node will be stored as a list in the IN variables.
dataEnteringNode = IN
inputRef = IN[0]
modification_GL_Z = IN[1]
# Place your code below this line
if inputRef == "Survey Point":
    GL_Z = Revit.Elements.Coordinates.SurveyPoint().Z + modification_GL_Z
elif inputRef == "Project Base Point":
    GL_Z = Revit.Elements.Coordinates.BasePoint().Z + modification_GL_Z
# Assign your output to the OUT variable.
OUT = GL_Z
# ----------------------------------------

# group: 지하 룸 추출
n3_토공산출모드_온통_개별 = CustomSelection("온통터파기", items={산출안함: "산출안함", 온통터파기: "온통터파기", 개별터파기: "개별터파기"})  # "3. 토공산출모드(온통 / 개별)"
rooms_by_status = RoomsByStatus()
location = Room.Location(room=rooms_by_status.PlacedRooms)
Z = Point.Z(point=location)
code_block_5 = CodeBlock(gl_elevation=python_script) { gl_elevation; }
code_block_6 = CodeBlock(room_Z=Z, GL_Z=code_block_5) { room_Z<GL_Z; }
filterByBoolMask = List.FilterByBoolMask(list=rooms_by_status.PlacedRooms, mask=code_block_6)
coreBoundary = Room.CoreBoundary(room=filterByBoolMask.in)
byJoinedCurves = PolyCurve.ByJoinedCurves(curves=coreBoundary)
byPatch = Surface.ByPatch(closedCurve=byJoinedCurves)
area = Surface.Area(surface=byPatch)
code_block_7 = CodeBlock(room_area=area) { room_area >= 1200*1200; }
filterByBoolMask_2 = List.FilterByBoolMask(list=byPatch, mask=code_block_7)
룸별_srf = CodeBlock(i=filterByBoolMask_2.in) { i; }
code_block_8 = CodeBlock(gl_elevation=code_block_5) { gl_elevation; }
parameters_2 = Element.Parameters(element=rooms_by_status.PlacedRooms)
finishBoundary = Room.FinishBoundary(room=filterByBoolMask.in)

code_block_9 = CodeBlock(gl_elevation=python_script) { gl_elevation; }

# group: 지하부재검출용 큐브생성
code_block_10 = CodeBlock(allElems=flatten) { allElems; }
code_block_11 = CodeBlock { "Family and Type"; }
getParameterValueByName_2 = Element.GetParameterValueByName(element=code_block_10, parameterName=code_block_11)
parameters_3 = Element.Parameters(element=getParameterValueByName_2)
basePoint = Coordinates.BasePoint()
Z_2 = Point.Z(point=basePoint)
surveyPoint = Coordinates.SurveyPoint()
Z_3 = Point.Z(point=surveyPoint)
code_block_12 = CodeBlock(gl_elevation=code_block_9) { gl_elevation; }
code_block_13 = CodeBlock { "Type Name"; }
getParameterValueByName_3 = Element.GetParameterValueByName(element=getParameterValueByName_2, parameterName=code_block_13)
code_block_14 = CodeBlock { "_S18_"; }
contains = String.Contains(string=getParameterValueByName_3, searchFor=code_block_14)
filterByBoolMask_3 = List.FilterByBoolMask(list=code_block_10, mask=contains)
code_block_15 = CodeBlock(i=filterByBoolMask_3.in) { i; }
geometry = Element.Geometry(element=code_block_15)
flatten_2 = List.Flatten(list=geometry)
byGeometry = BoundingBox.ByGeometry(geom=flatten_2)
toCuboid = BoundingBox.ToCuboid(boundingBox=byGeometry)
윗면_아랫면추출 = Python(IN[0]=Z_2, IN[1]=Z_3, IN[2]=code_block_12, IN[3]=toCuboid)  # CPython3
# ---------- 윗면_아랫면추출.python (84 lines) ----------
# Load the Python Standard and DesignScript Libraries
import sys
import clr
clr.AddReference('ProtoGeometry')
from Autodesk.DesignScript.Geometry import *
################Module For Functional Programing#########################
from functools import reduce
from itertools import chain
from itertools import groupby
from copy import deepcopy

curry = lambda f: lambda a, *args: (
    f(a, *args) if (len(args)) else lambda *args: f(a, *args)
)

filter, map, reduce = curry(filter), curry(map), curry(reduce)

go = lambda *args: reduce(lambda a, f: f(a), args)  ## 함수도 축약 가능 ##


def dictUpdate(dic1, dic2):
    dic1.update(dic2)
    return dic1


def dictsMerge(dics):
    res = reduce(dictUpdate, dics)
    return res


def dictDeleteKeys(dic, keys):
    for k in keys:
        del dic[k]
    return dic


def flat(a):
    if isinstance(a, list):
        for i in a:
            yield from flat(i)
    else:
        yield a


def grpBy(iter, key):
    f, grpKeys, grps = key, [], []
    sorted_ = sorted(iter, key=f)
    for key, grp_data in groupby(sorted_, key=f):
        grpKeys.append(key)
        grps.append(list(grp_data))
    return grps, grpKeys
#########################################################################
# The inputs to this node will be stored as a list in the IN variables.
dataEnteringNode = IN
basePoint_elevation = IN[0]
surveyPoint_elevation = IN[1]
gl_elevation = IN[2]
bdbox_cuboid = IN[3]

# Place your code below this line

upperSrf = go(
    bdbox_cuboid.Explode(),
    filter(lambda x: x.NormalAtParameter(0.5,0.5).Z==1),
    list,
    lambda x: x[0],
)

gap_BasePoitAndGL = surveyPoint_elevation - basePoint_elevation - gl_elevation


modi_elv_value = gl_elevation - upperSrf.PointAtParameter(0.5,0.5).Z

modified_upperSrf = upperSrf.Translate(0,0,modi_elv_value)

belowSrf = go(
    bdbox_cuboid.Explode(),
    filter(lambda x: x.NormalAtParameter(0.5,0.5).Z==-1),
    list,
    lambda x: x[0],
)

# Assign your output to the OUT variable.
OUT = modified_upperSrf, belowSrf, modi_elv_value
# ----------------------------------------
code_block_16 = CodeBlock(i=윗면_아랫면추출) { [i[0],i[1]]; }
perimeterCurves = Surface.PerimeterCurves(surface=code_block_16)
byJoinedCurves_2 = PolyCurve.ByJoinedCurves(curves=perimeterCurves)
byLoft = Solid.ByLoft(crossSections=byJoinedCurves_2)

code_block_17 = CodeBlock(upperAndbelow=code_block_16) { upperAndbelow; }
n1_bnote_경로_입력 = Filename("..\H_FamilyList_FP\HGEN_20241028.bnote")  # "1. BNOTE 경로 입력"; graph input
file_from_path_2 = FileObject(path=n1_bnote_경로_입력)
readText = FileSystem.ReadText(file=file_from_path_2)
parseJSON = Data.ParseJSON(json=readText)
code_block_18 = CodeBlock(d=parseJSON) { d["common_info"]; }
code_block_19 = CodeBlock(d=code_block_18) { d["earth"]; }
code_block_20 = CodeBlock(d=code_block_19) { d["항목"]; }
code_block_21 = CodeBlock()
# ---------- code_block_21.designscript (4 lines) ----------
[
"입력값",
"단위"
];
# ----------------------------------------
code_block_22 = CodeBlock(d=code_block_19) { d["입력값"]; }
code_block_23 = CodeBlock(d=code_block_19) { d["단위"]; }
list_create_3 = List.Create(item0=code_block_22, item1=code_block_23)
transpose = List.Transpose(lists=list_create_3)
byKeysValues = DesignScript.Builtin.Dictionary.ByKeysValues(keys=code_block_21, values=transpose@L2)
byKeysValues_2 = DesignScript.Builtin.Dictionary.ByKeysValues(keys=code_block_20, values=byKeysValues@L2)
code_block_24 = CodeBlock(CommonInfo=byKeysValues_2) { CommonInfo; }
code_block_25 = CodeBlock(CommonInfo=code_block_24) { CommonInfo[0]; }

# group: 지중부재 전체
geometry_2 = Element.Geometry(element=flatten)
flatten_3 = List.Flatten(list=geometry_2)
doesIntersect = Geometry.DoesIntersect(geometry=byLoft, other=flatten_3)
filterByBoolMask_4 = List.FilterByBoolMask(list=flatten, mask=doesIntersect)

code_block_26 = CodeBlock(i=filterByBoolMask_4.in) { i; }
code_block_27 = CodeBlock { "Family and Type"; }
getParameterValueByName_4 = Element.GetParameterValueByName(element=code_block_26, parameterName=code_block_27)
code_block_28 = CodeBlock { "Type Name"; }
getParameterValueByName_5 = Element.GetParameterValueByName(element=getParameterValueByName_4, parameterName=code_block_28)
code_block_29 = CodeBlock { "_S15_"; }
contains_2 = String.Contains(string=getParameterValueByName_5, searchFor=code_block_29)
filterByBoolMask_5 = List.FilterByBoolMask(list=code_block_26, mask=contains_2)
code_block_30 = CodeBlock(gl_elevation=code_block_9) { gl_elevation; }
code_block_31 = CodeBlock(gl_elevation=code_block_30) { gl_elevation; }

# group: 온통터파기 외곽 라인 추출
getLocation = Element.GetLocation(element=filterByBoolMask_5.in)
code_block_32 = CodeBlock(gl_elevation=code_block_31) { gl_elevation; }
Z_4 = Point.Z(point=getLocation)
code_block_33 = CodeBlock(GL_Z=code_block_32, point_Z=Z_4) { GL_Z-point_Z; }
translate = Geometry.Translate(geometry=getLocation, zTranslation=code_block_33)
code_block_34 = CodeBlock { 10000; }
concave_hull = Python(IN[0]=translate, IN[1]=code_block_34)  # CPython3
# ---------- concave_hull.python (63 lines) ----------
# Load the Python Standard and DesignScript Libraries
import sys
import clr
clr.AddReference('ProtoGeometry')
from Autodesk.DesignScript.Geometry import *
from Autodesk.DesignScript.Geometry import Line

from math import sqrt, hypot

# The inputs to this node will be stored as a list in the IN variables.
dataEnteringNode = IN
points = UnwrapElement(IN[0])
alpha = IN[1]
# Place your code below this line

def concave_hull(points, alpha):
    res = []
    
    pLen = len(points)
    alpha2 = alpha * alpha
    if pLen < 2:
        raise Exception('AlphaShape needs at least 2 points')

    for i, p in enumerate(points):
        for j in range(i+1, pLen):
#            if p.IsAlmostEqualTo(points[j]):
#                raise Exception('AlphaShape needs pairwise distinct points')
            dist = hypot(p.X - points[j].X, p.Y - points[j].Y)                    
            if (dist > 2 * alpha) : continue #circle fits between points ==> p_i, p_j can't be alpha-exposed                    
    
            x1, y1, x2, y2 = p.X, p.Y, points[j].X, points[j].Y
            midX, midY = (x1 + x2) / 2, (y1 + y2) / 2
    
            #find two circles that contain p_i and p_j; note that center1 == center2 if dist == 2*alpha
            #alphaDist = sqrt(alpha2 - (dist / 2) ** 2)
            alphaDist_ = alpha2 - (dist / 2) ** 2
            alphaDist = sqrt(alphaDist_)
            deltaX, deltaY = (x2 - x1) / dist, (y1 - y2) / dist
            c1x, c1y = midX + alphaDist * deltaY, midY + alphaDist * deltaX
            c2x, c2y = midX - alphaDist * deltaY, midY - alphaDist * deltaX
            
            #check if one of the circles is alpha-exposed, i.e. no other point lies in it
            c1_empty = True 
            c2_empty = True
            for k in range(pLen):                
                if i == k or j == k: 
                    continue
                if ((c1x - points[k].X) * (c1x - points[k].X) + (c1y - points[k].Y) * (c1y - points[k].Y) < alpha2):
                    c1_empty = False
                if ((c2x - points[k].X) * (c2x - points[k].X) + (c2y - points[k].Y) * (c2y - points[k].Y) < alpha2):
                    c2_empty = False
                if not c1_empty and not c2_empty:
                    break
            if c1_empty or c2_empty:
                res.append(Line.ByStartPointEndPoint(p, points[j]))
                #res.append(c1_empty)
    return res
    #return alphaDist



# Assign your output to the OUT variable.
OUT = concave_hull(points, alpha)
# ----------------------------------------

byJoinedCurves_3 = PolyCurve.ByJoinedCurves(curves=concave_hull)
byPatch_2 = Surface.ByPatch(closedCurve=byJoinedCurves_3)
바운딩박스_아랫면 = CodeBlock(i=윗면_아랫면추출) { i[1]; }
code_block_35 = CodeBlock { 0.5; }
pointAtParameter = Surface.PointAtParameter(surface=바운딩박스_아랫면, u=code_block_35, v=code_block_35)
Z_5 = Point.Z(point=pointAtParameter)
code_block_36 = CodeBlock(터파기시작레벨=Z_5) { 터파기시작레벨; }
code_block_37 = CodeBlock(터파기시작레벨=code_block_36) { 터파기시작레벨; }
code_block_38 = CodeBlock(터파기시작레벨=code_block_37) { 터파기시작레벨; }
code_block_39 = CodeBlock(gl_elevation=code_block_32) { gl_elevation; }
code_block_40 = CodeBlock(터파기시작레벨=code_block_38, GL_Z=code_block_39) { translate_height= 터파기시작레벨-GL_Z; }
translate_2 = Geometry.Translate(geometry=byPatch_2, zTranslation=code_block_40)
list_create_4 = List.Create(item0=byPatch_2, item1=translate_2)
code_block_41 = CodeBlock(upperAndbelow=list_create_4) { upperAndbelow; }
n4_g_경사도_입력_45도_1 = DoubleSlider(1, range=0..1 step 0.1)  # "4. G(경사도 입력) - 45도 : 1"; graph input
code_block_42 = CodeBlock(G=n4_g_경사도_입력_45도_1) { G; }
code_block_43 = CodeBlock(G=code_block_42) { G; }
code_block_44 = CodeBlock(G=code_block_43) { G; }
토공 = Python(IN[0]=code_block_25, IN[1]=filterByBoolMask_4.in, IN[2]=code_block_41, IN[3]=code_block_44)  # CPython3
# ---------- 토공.python (110 lines) ----------
# Load the Python Standard and DesignScript Libraries
import sys
import clr
clr.AddReference('ProtoGeometry')
from Autodesk.DesignScript.Geometry import *
import Revit
################Module For Functional Programing##########################
from functools import reduce
from itertools import chain
from itertools import groupby
from copy import deepcopy
curry = lambda f: lambda a,*args: f(a, *args) if (len(args)) else lambda *args: f(a, *args)

filter = curry(filter)
map = curry(map)
reduce = curry(reduce)

go = lambda *args: reduce(lambda a,f: f(a), args) ## 함수도 축약 가능 ##

def dictUpdate(dic1,dic2):
    res = dic1.update(dic2)
    #res = {**dic1,**dic2}
    return dic1 #res
    
def dictsMerge(dics):
    res = reduce(dictUpdate, dics)
    return res
    
def dictDeleteKeys(dic, keys):
    for k in keys:
        del dic[k]
    return dic
##########################################################################
# The inputs to this node will be stored as a list in the IN variables.
dataEnteringNode = IN
earth_CommonInfoDict = IN[0]
allUGElems = IN[1]
whole_cuboid_upperSrf = IN[2][0]
whole_cuboid_belowSrf = IN[2][1]
G = IN[3]
# Place your code below this line

SurveyPoint_Z = Revit.Elements.Coordinates.SurveyPoint().Z
BasePoint_Z = Revit.Elements.Coordinates.BasePoint().Z

pjt_level_calibration = BasePoint_Z - SurveyPoint_Z

GWL_ = earth_CommonInfoDict["지하수위"]["입력값"] * 1000

GWL = GWL_# - pjt_level_calibration

GWLplane = Plane.ByOriginNormal(Point.ByCoordinates(0,0,GWL), Vector.ByCoordinates(0,0,1))


def create_excaShape(upperSrf, belowSrf, earth_CommonInfoDict):
    below_Z = whole_cuboid_belowSrf.PointAtParameter(0.5,0.5).Z
    excaHeight = - below_Z
    base_downHeight = float(earth_CommonInfoDict["Base 두께"]["입력값"])*1000\
                    + float(earth_CommonInfoDict["SubBase 두께"]["입력값"])*1000
    belowOffset = float(earth_CommonInfoDict["Lean 돌출길이"]["입력값"])*1000\
                    + float(earth_CommonInfoDict["터파기 여유폭"]["입력값"])*1000
    upperOffset = G * excaHeight + belowOffset

    find_belowRef = lambda belowSrf: go(
        belowSrf,
        lambda x: x.Translate(0, 0, -base_downHeight),
        lambda x: x.PerimeterCurves(),
        PolyCurve.ByJoinedCurves,
        lambda x: x.OffsetMany(belowOffset, False, Vector.ZAxis()),
        lambda x: x[0],
#        Surface.ByPatch,
#        BoundingBox.ByGeometry,
#        lambda x: [x.MinPoint, x.MaxPoint],
#        lambda x: Cuboid.ByCorners(*x),
#        lambda x: x.Explode()[0],
#        lambda x: x.PerimeterCurves(),
#        PolyCurve.ByJoinedCurves,
    )
    
    find_upperRef = lambda upperSrf: go(
        upperSrf,
        lambda x: x.PerimeterCurves(),
        PolyCurve.ByJoinedCurves,
        lambda x: x.OffsetMany(-upperOffset, False, Vector.ZAxis()),
        lambda x: x[0],
#        Surface.ByPatch,
#        BoundingBox.ByGeometry,
#        lambda x: [x.MinPoint, x.MaxPoint],
#        lambda x: Cuboid.ByCorners(*x),
#        lambda x: x.Explode()[0],
#        lambda x: x.PerimeterCurves(),
#        PolyCurve.ByJoinedCurves,
    )
#    belowRefs = list(map(find_belowRef, [belowSrf]))
#    upperRefs = list(map(find_upperRef, [upperSrf]))

#    exca_RefGroups = list(zip(belowRefs,upperRefs))
#    exca_Shape = Solid.ByUnion( map(Solid.ByLoft, exca_RefGroups) )

    belowRef = find_belowRef(belowSrf)
    upperRef = find_upperRef(upperSrf)
    
    exca_RefGroup = [belowRef, upperRef]
    exca_Shape = Solid.ByLoft(exca_RefGroup)
    
    return exca_Shape
    #return belowRef, upperRef, belowOffset

# Assign your output to the OUT variable.
OUT = create_excaShape(whole_cuboid_upperSrf, whole_cuboid_belowSrf, earth_CommonInfoDict), GWLplane
# ----------------------------------------
exca_Shape = CodeBlock(i=토공) { i[0]; }
code_block_45 = CodeBlock { 0.5; }
pointAtParameter_2 = Surface.PointAtParameter(surface=룸별_srf, u=code_block_45, v=code_block_45)
Z_6 = Point.Z(point=pointAtParameter_2)
code_block_46 = CodeBlock(GL_Z=code_block_8, room_Z=Z_6) { GL_Z - room_Z; }
boolean_2 = BoolSelector(false)
thicken = Surface.Thicken(surface=룸별_srf, thickness=code_block_46, both_sides=boolean_2)
byUnion = Solid.ByUnion(solids=thicken)
geometry_3 = Element.Geometry(element=filterByBoolMask_4.in)
flatten_4 = List.Flatten(list=geometry_3)

# group: 토탈 잔토처리 (룸 + 부재)
code_block_47 = CodeBlock(roomShape=byUnion) { roomShape; }
byUnion_2 = Solid.ByUnion(solids=flatten_4)
join_2 = List.Join(list0=code_block_47, list1=byUnion_2)
byUnion_3 = Solid.ByUnion(solids=join_2)

split = Geometry.Split(geometry=exca_Shape, other=byUnion_3)
categories_2 = Categories("OST_GenericModel")
code_block_48 = CodeBlock { "earth_shape"; }
geometry_4 = Element.Geometry(element=filterByBoolMask_5.in)  # frozen
thicken_2 = Surface.Thicken(surface=룸별_srf, thickness=code_block_46)
code_block_49 = CodeBlock()
# ---------- code_block_49.designscript (6 lines) ----------
[
"터파기_지하수위상부",
"터파기_지하수위하부",
"되메우기",
"잔토처리"
];
# ----------------------------------------

# group: EXCAVATION
GWL_Plane = CodeBlock(i=토공) { i[1]; }
split_2 = Geometry.Split(geometry=exca_Shape, other=GWL_Plane)

# group: ABOBE GWL EXCAVATION
code_block_50 = CodeBlock(i=split_2) { i[0]; }
volume = Solid.Volume(solid=code_block_50)
code_block_51 = CodeBlock { 1000000000; }
div = volume / code_block_51

# group: BELOW GWL EXCAVATION
code_block_52 = CodeBlock(i=split_2) { i[1]; }
volume_2 = Solid.Volume(solid=code_block_52)
code_block_53 = CodeBlock { 1000000000; }
div_2 = volume_2 / code_block_53

# group: DISPOSAL
code_block_54 = CodeBlock { 1000000000; }
code_block_55 = CodeBlock(i=split) { i[1]; }
volume_3 = Solid.Volume(solid=code_block_55)
div_3 = volume_3 / code_block_54

# group: BACKFILL
code_block_56 = CodeBlock(i=split) { i[0]; }
volume_4 = Solid.Volume(solid=code_block_56)
div_4 = volume_4 / code_block_54

byGeometry_2 = DirectShape.ByGeometry(geometry=code_block_56, category=categories_2, name=code_block_48)
join_3 = List.Join(list0=div, list1=div_2, list2=div_4, list3=div_3)
code_block_57 = CodeBlock { 2; }
round = Math.Round(number=join_3, digits=code_block_57)
byKeysValues_3 = DesignScript.Builtin.Dictionary.ByKeysValues(keys=code_block_49, values=round)
watch = Watch(byKeysValues_3)  # graph output
