# Dynamo graph [H_PAB.RT.Q2B]_Revit 토공 물량 자동산출_[0.0.0].dyn (Dynamo 2.16.1.2727)
# author: MK Jang
# Auto Calculating the Quantities of each Element As per the Family List

building_name = CodeBlock { bdName; }  # unwired: bdName

# group: HTML 부재별 물량 기입 구간
javascriptPart = Python()  # CPython3; unwired: IN[0], IN[1], IN[2]
# ---------- javascriptPart.python (59 lines) ----------
# Load the Python Standard and DesignScript Libraries
import sys
import clr
clr.AddReference('ProtoGeometry')
from Autodesk.DesignScript.Geometry import *

# The inputs to this node will be stored as a list in the IN variables.
dataEnteringNode = IN

# Place your code below this line
jsPart = '''
function hideAllPages() {
        document.querySelector("#home").style.fontWeight = "normal";
        document.querySelector("#homePage").style.display = "None";
        document.querySelector("#info").style.fontWeight = "normal";
        document.querySelector("#infoPage").style.display = "None";
        document.querySelector("#famType").style.fontWeight = "normal";
        document.querySelector("#famTypePage").style.display = "None";
        document.querySelector("#roomInfo").style.fontWeight = "normal";
        document.querySelector("#roomInfoPage").style.display = "None";
        document.querySelector("#roomInfoPage_chk").style.display = "None";
}

document.querySelector("#cat").onclick = function() {
	    let img = document.createElement("img");
	    img.setAttribute("src", "https://t4.ftcdn.net/jpg/05/62/99/31/360_F_562993122_e7pGkeY8yMfXJcRmclsoIjtOoVDDgIlh.jpg");
	    document.querySelector("#cat").style.display = "None";
	    img.setAttribute("style", "width:300px;margin-top:20px;")
	    document.body.append(img);
	};
document.querySelector("#home").onclick = function() {
        hideAllPages();
        document.querySelector("#home").style.fontWeight = "bolder";
        document.querySelector("#homePage").style.display = "inline";
	};
document.querySelector("#info").onclick = function() {
        hideAllPages();
        document.querySelector("#info").style.fontWeight = "bolder";
        document.querySelector("#infoPage").style.display = "inline";
	};
document.querySelector("#famType").onclick = function() {
        hideAllPages();
        document.querySelector("#famType").style.fontWeight = "bolder";
        document.querySelector("#famTypePage").style.display = "inline";
	};
document.querySelector("#roomInfo").onclick = function() {
        hideAllPages();
        document.querySelector("#roomInfo").style.fontWeight = "bolder";
        document.querySelector("#roomInfoPage").style.display = "inline";
	};
document.querySelector("#roomInfo_chk").onclick = function() {
        hideAllPages();
        document.querySelector("#roomInfo_chk").style.fontWeight = "bolder";
        document.querySelector("#roomInfoPage_chk").style.display = "inline";
	};
	
'''
# Assign your output to the OUT variable.
OUT = jsPart
# ----------------------------------------
cssPart = Python()  # CPython3; unwired: IN[0], IN[1], IN[2]
# ---------- cssPart.python (125 lines) ----------
# Load the Python Standard and DesignScript Libraries
import sys
import clr
clr.AddReference('ProtoGeometry')
from Autodesk.DesignScript.Geometry import *

# The inputs to this node will be stored as a list in the IN variables.
dataEnteringNode = IN

# Place your code below this line
cssPart = '''

/* style.css */
img {
 width : 25%;
 height: 25%; 
}

:root {
  --text-color: #f0f4f5;
  --background-color: #263343;
  --accent-color: orange;
  --icons-color: rgb(152, 187, 201);
  --bodybackground-color: lightgray;
}

th {
  text-align: center;
  padding-left: 30px;
}

td {
  padding-left: 40px;
  border-bottom : 1px solid gray;
  border-collapse : collapse;
}

body {
  margin: 0;
  background-color: var(--bodybackground-color);
  font-family: 'STIX Two Math';
} 

a {
  text-decoration: none;
  color: var(--text-color);
}

.navbar {
  display: flex;
  position: sticky;
  top: 0px; /* 도달했을때 고정시킬 위치 */
  justify-content: space-between;
  align-items: center;
  background-color: var(--background-color);
  padding: 8px 12px;
  font-family: 'STIX Two Math';
}

.navbar__logo i {
  color: var(--accent-color);
  padding-left: 0;
}

.navbar__menu {
  list-style: none;
  display: flex;
  margin: 0;
  padding-left: 0;
}

.navbar__menu li {
  padding: 8px 30px;
  color: var(--text-color);
}

.navbar__menu li:hover {
  background-color: var(--accent-color);
  border-radius: 3px;
}

.navbar__icons {
  list-style: none;
  display: flex;
  color: var(--icons-color);
  margin: 0;
  padding-left: 0;
}

.navbar__icons li {
  padding: 8px 12px;
  margin: 0;
}

#cat {
  display: block;
  }

#home {
  font-weight: bolder;
  }

#homePage {
  display: inline;
  }

#infoPage {
  display: None;
  }

#famTypePage {
  display: None;
  }

#roomInfoPage {
  display: None;
  }

#roomInfoPage_chk {
  display: None;
  }

'''
# Assign your output to the OUT variable.
OUT = cssPart
# ----------------------------------------
navHTML_Part = Python()  # CPython3; unwired: IN[0]
# ---------- navHTML_Part.python (24 lines) ----------
# Load the Python Standard and DesignScript Libraries
import sys
import clr
clr.AddReference('ProtoGeometry')
from Autodesk.DesignScript.Geometry import *

# The inputs to this node will be stored as a list in the IN variables.
dataEnteringNode = IN

# Place your code below this line
navPart = f"""

<nav class="navbar">

  <ul class="navbar__menu">
    <li id="home">Home</li>
  </ul>

</nav>

"""

# Assign your output to the OUT variable.
OUT = navPart
# ----------------------------------------
list_create = List.Create()  # unwired: item0
make_htmlStr = Python(IN[0]=javascriptPart, IN[1]=cssPart, IN[2]=navHTML_Part, IN[3]=building_name, IN[4]=list_create)  # CPython3; frozen
# ---------- make_htmlStr.python (59 lines) ----------
# Load the Python Standard and DesignScript Libraries
import sys
import clr
clr.AddReference('ProtoGeometry')
from Autodesk.DesignScript.Geometry import *

# The inputs to this node will be stored as a list in the IN variables.
dataEnteringNode = IN
jsPart = IN[0]
cssPart = IN[1]
navPart = IN[2]

pjtName = IN[3][0]
bdName = IN[3][1]
pages = IN[4]

homePage = pages[0]



# Place your code below this line
##folderPath_r = folderPath.replace('\\','\\\\')

htmlStr = f'''
<!DOCTYPE html>
<html lang="ko">

<head>
    <link rel="shortcut icon" href="#">
    <meta charset="UTF-8">
    <title>RVT Calculation Result</title>
    <style>
        {cssPart}
    </style>
</head>

<header>
<h5>Revit Elements' Bill of Quantities Page</h5>
<h4>{pjtName}</h4>
<h4>{bdName}</h4>
</header>

<body>
{navPart}

<div id="homePage">
{homePage}
</div>



<script type ="module" src="./js/script.js"></script>

</body>

</html>
'''
# Assign your output to the OUT variable.
OUT = htmlStr
# ----------------------------------------
code_block = CodeBlock(htmlStr=make_htmlStr) { htmlStr; }
serverFilePath = CodeBlock { ".dynTemp"; }
htmlPath = Python(IN[0]=serverFilePath)  # CPython3
# ---------- htmlPath.python (35 lines) ----------
# Load the Python Standard and DesignScript Libraries
import sys
import clr
clr.AddReference('ProtoGeometry')
from Autodesk.DesignScript.Geometry import *
import time
import subprocess
import os

clr.AddReference('RevitNodes')
import Revit
clr.ImportExtensions(Revit.Elements)
from Revit import Elements
# The inputs to this node will be stored as a list in the IN variables.
dataEnteringNode = IN
dynTempServerPath = IN[0]
# Place your code below this line
def find_cwd():
    doc = Revit.Application.Document.Current
    filePath_string = doc.FilePath
    folderPath = filePath_string.split('\\')
    folderPath.pop(-1)
    folderPath_str = '\\'.join(folderPath)
    return folderPath_str

cwd = find_cwd()
#cwd = os.getenv("HomePath")

folderPath = f"{cwd}\\{dynTempServerPath}\\tmpForBOQ"
if not os.path.exists(folderPath):
    os.makedirs(folderPath)

# Assign your output to the OUT variable.
#OUT = "C:"+folderPath
OUT = folderPath
# ----------------------------------------
n0_set_port_number_기본값_8000_작동_오류 = StringInput("8000")  # "0. Set Port Number: 기본값-8000 (작동 오류 없다면 변경 금지)"
create_html_file_and_open = Python(IN[0]=code_block, IN[1]=htmlPath, IN[2]=n0_set_port_number_기본값_8000_작동_오류)  # CPython3
# ---------- create_html_file_and_open.python (85 lines) ----------
# Load the Python Standard and DesignScript Libraries
import os
import sys
import clr
clr.AddReference('ProtoGeometry')
from Autodesk.DesignScript.Geometry import *

clr.AddReference('RevitNodes')
import Revit
clr.ImportExtensions(Revit.Elements)
from Revit import Elements

import time
import subprocess
import asyncio
import multiprocessing

#################################Module For Functional Programing#############################################
from functools import reduce
curry = lambda f: lambda a,*args: f(a, *args) if (len(args)) else lambda *args: f(a, *args)

filter = curry(filter)
map = curry(map)

def _take(length, iter):
    res = []
    for a in iter:
        res.append(a)
        if len(res) == length:
            return res
        
take = curry(_take)
reduce = curry(reduce)

go = lambda *args: reduce(lambda a,f: f(a), args) ## 함수도 축약 가능 ##
##############################################################################################################

# The inputs to this node will be stored as a list in the IN variables.
dataEnteringNode = IN
contents = IN[0]
folderPath = IN[1]
cwd = folderPath
portNo = IN[2]
#bdName = IN[2]
# Place your code below this line

def find_cwd():
    doc = Revit.Application.Document.Current
    filePath_string = doc.FilePath
    folderPath = filePath_string.split('\\')
    folderPath.pop(-1)
    folderPath_str = '\\'.join(folderPath)
    return folderPath_str

def make_resultHTMLname(htmlStr,title,cwd):
    timeStamp = time.strftime('%H_%M_%S', time.localtime(time.time()))
    #folderPath = f"{cwd}\\.dynLog"
    folderPath = cwd
    if not os.path.exists(folderPath):
        os.makedirs(folderPath)
    fileName = f"index.html"
    filePath = f"{folderPath}\\" + fileName
    f = open(filePath, 'w', encoding='utf8')
    f.write(htmlStr)
    f.close()
    return fileName


def execute_browser(cwd):
    #cwd = find_cwd()
    folderPath = cwd
    os.chdir(folderPath)
    #cmdStr = "start chrome http:localhost:8000"
    cmdStr = f"start msedge http:localhost:{portNo}"
    cmdList= cmdStr.split(' ')
    #subprocess.run(args=[fileName], shell=True)
    #subprocess.run(args=['start','excel',fileName], shell=True)
    subprocess.run(args=cmdList, shell=True)
    return cmdList


fileName = make_resultHTMLname(contents,"test",cwd)

# Assign your output to the OUT variable.
OUT = execute_browser(cwd)#fileName.split('.')[0]
# ----------------------------------------
create_js_file = Python(IN[0]=javascriptPart, IN[1]=htmlPath)  # CPython3; unwired: IN[2]
# ---------- create_js_file.python (84 lines) ----------
# Load the Python Standard and DesignScript Libraries
import os
import sys
import clr
clr.AddReference('ProtoGeometry')
from Autodesk.DesignScript.Geometry import *

clr.AddReference('RevitNodes')
import Revit
clr.ImportExtensions(Revit.Elements)
from Revit import Elements

import time
import subprocess

#################################Module For Functional Programing#############################################
from functools import reduce
curry = lambda f: lambda a,*args: f(a, *args) if (len(args)) else lambda *args: f(a, *args)

filter = curry(filter)
map = curry(map)

def _take(length, iter):
    res = []
    for a in iter:
        res.append(a)
        if len(res) == length:
            return res
        
take = curry(_take)
reduce = curry(reduce)

go = lambda *args: reduce(lambda a,f: f(a), args) ## 함수도 축약 가능 ##
##############################################################################################################

# The inputs to this node will be stored as a list in the IN variables.
dataEnteringNode = IN
contents = IN[0]
folderPath = IN[1]
#bdName = IN[2]
# Place your code below this line
def find_cwd():
    doc = Revit.Application.Document.Current
    filePath_string = doc.FilePath
    folderPath = filePath_string.split('\\')
    folderPath.pop(-1)
    folderPath_str = '\\'.join(folderPath)
    return folderPath_str

#cwd = find_cwd()
cwd = folderPath

def make_resultHTMLname(jsStr,cwd):
    #timeStamp = time.strftime('%H_%M_%S', time.localtime(time.time()))
    #folderPath = f"{cwd}\\.dynLog"
    folderPath = cwd
    jsPath = cwd + "\\js"
    if not os.path.exists(folderPath):
        os.makedirs(folderPath)
    if not os.path.exists(jsPath):
        os.makedirs(jsPath)
    fileName = "script.js"
    filePath = f"{jsPath}\\" + fileName
    f = open(filePath, 'w', encoding='utf8')
    f.write(jsStr)
    f.close()
    return fileName

def execute_file(fileName):
    #cwd = find_cwd()
    folderPath = cwd
    os.chdir(folderPath)
    subprocess.run(args=[fileName], shell=True)
    #subprocess.run(args=['start','excel',fileName], shell=True)
    

fileName = make_resultHTMLname(contents,cwd)
#fileName = "Test1.html"

#execute_file(fileName)


# Assign your output to the OUT variable.
OUT = fileName
# ----------------------------------------
start_webserver = Python(IN[0]=htmlPath, IN[1]=n0_set_port_number_기본값_8000_작동_오류)  # CPython3
# ---------- start_webserver.python (48 lines) ----------
# Load the Python Standard and DesignScript Libraries
import sys
import clr
clr.AddReference('ProtoGeometry')
from Autodesk.DesignScript.Geometry import *

import os
import asyncio
import multiprocessing
import subprocess
# The inputs to this node will be stored as a list in the IN variables.
dataEnteringNode = IN
cwd = IN[0]
portNo = IN[1]
# Place your code below this line
batStr = f"""
@echo on
python -m http.server {portNo}
cmd /k
"""
##cmd /k
title = "localWebserver"

def make_startSever_bat(batStr,title,cwd):
    folderPath = cwd
    if not os.path.exists(folderPath):
        os.makedirs(folderPath)
    fileName = f"{title}.bat"
    filePath = f"{folderPath}\\" + fileName
    f = open(filePath, 'w', encoding='utf8')
    f.write(batStr)
    f.close()
    return fileName

def startBat(fileName, cwd):
    cmdStr = f".\\{fileName}"
    cmdList= cmdStr.split(' ')
    os.chdir(cwd)
    
    res = subprocess.Popen(args=cmdList, shell=True)
    return res

batFileName = make_startSever_bat(batStr,title,cwd)
#res = multiprocessing.Process(name="SubProcess", target=startBat, args=(batFileName, cwd))
# Assign your output to the OUT variable.
OUT = startBat(batFileName, cwd)

#startBat(fileName, cwd)
# ----------------------------------------
make_htmlStr_2 = Python(IN[0]=javascriptPart, IN[1]=cssPart)  # CPython3; unwired: IN[2]
# ---------- make_htmlStr_2.python (53 lines) ----------
# Load the Python Standard and DesignScript Libraries
import sys
import clr
clr.AddReference('ProtoGeometry')
from Autodesk.DesignScript.Geometry import *

# The inputs to this node will be stored as a list in the IN variables.
dataEnteringNode = IN
jsPart = IN[0]
cssPart = IN[1]
tablePart = IN[2]

# Place your code below this line
##folderPath_r = folderPath.replace('\\','\\\\')

htmlStr = f'''
<!DOCTYPE html>
<html lang="ko">

<head>
    <meta charset="UTF-8">
    <title>my first three.js app</title>
    <style>
        {cssPart}
    </style>
</head>

<body>


<div class="wrapper">

  <a data-fslightbox="gallery" href="#custom-source">
    유튜브 라이트박스
  </a>

  <iframe id="custom-source"
          frameborder="0"
          width="1920px"
          height="1080px"
          allow="autoplay; fullscreen"
          src="https://www.youtube.com/embed/qgBSiRwsbNw?autoplay=1">
  </iframe>
</div>

<script src="https://cdnjs.cloudflare.com/ajax/libs/fslightbox/3.3.1/index.min.js" integrity="sha512-EqNNJuepkw5P9vxCml8eBk7C4Ld+4kAnvzOD/jG21rkxWPILGoQa5EvD62UieiJF0u3xoQrcVnce4i83VnYj/Q==" crossorigin="anonymous" referrerpolicy="no-referrer"></script>

</body>

</html>
'''
# Assign your output to the OUT variable.
OUT = htmlStr
# ----------------------------------------

code_block_2 = CodeBlock { refLevel; }  # frozen; unwired: refLevel

# group: 온통터파기 외곽 라인 추출
code_block_3 = CodeBlock(refLevel=code_block_2) { gl_elevation; refLevel; gl_elevation - refLevel; }  # unwired: gl_elevation
getLocation = Element.GetLocation()  # frozen; unwired: element
Z = Point.Z(point=getLocation)
code_block_4 = CodeBlock(GL_Z=code_block_3.out2, point_Z=Z) { GL_Z-point_Z; }
code_block_5 = CodeBlock(point_Z=Z, GL_Z=code_block_3.out2) { point_Z - GL_Z; }
translate = Geometry.Translate(geometry=getLocation, zTranslation=code_block_5)
code_block_6 = CodeBlock { 5000; }
concave_hull = Python(IN[0]=translate, IN[1]=code_block_6)  # CPython3
# ---------- concave_hull.python (63 lines) ----------
# Load the Python Standard and DesignScript Libraries
import sys
import clr
clr.AddReference('ProtoGeometry')
from Autodesk.DesignScript.Geometry import *
from Autodesk.DesignScript.Geometry import Line

from math import sqrt, hypot

# The inputs to this node will be stored as a list in the IN variables.
dataEnteringNode = IN
points = UnwrapElement(IN[0])
alpha = IN[1]
# Place your code below this line

def concave_hull(points, alpha):
    res = []
    
    pLen = len(points)
    alpha2 = alpha * alpha
    if pLen < 2:
        raise Exception('AlphaShape needs at least 2 points')

    for i, p in enumerate(points):
        for j in range(i+1, pLen):
#            if p.IsAlmostEqualTo(points[j]):
#                raise Exception('AlphaShape needs pairwise distinct points')
            dist = hypot(p.X - points[j].X, p.Y - points[j].Y)                    
            if (dist > 2 * alpha) : continue #circle fits between points ==> p_i, p_j can't be alpha-exposed                    
    
            x1, y1, x2, y2 = p.X, p.Y, points[j].X, points[j].Y
            midX, midY = (x1 + x2) / 2, (y1 + y2) / 2
    
            #find two circles that contain p_i and p_j; note that center1 == center2 if dist == 2*alpha
            #alphaDist = sqrt(alpha2 - (dist / 2) ** 2)
            alphaDist_ = alpha2 - (dist / 2) ** 2
            alphaDist = sqrt(alphaDist_)
            deltaX, deltaY = (x2 - x1) / dist, (y1 - y2) / dist
            c1x, c1y = midX + alphaDist * deltaY, midY + alphaDist * deltaX
            c2x, c2y = midX - alphaDist * deltaY, midY - alphaDist * deltaX
            
            #check if one of the circles is alpha-exposed, i.e. no other point lies in it
            c1_empty = True 
            c2_empty = True
            for k in range(pLen):                
                if i == k or j == k: 
                    continue
                if ((c1x - points[k].X) * (c1x - points[k].X) + (c1y - points[k].Y) * (c1y - points[k].Y) < alpha2):
                    c1_empty = False
                if ((c2x - points[k].X) * (c2x - points[k].X) + (c2y - points[k].Y) * (c2y - points[k].Y) < alpha2):
                    c2_empty = False
                if not c1_empty and not c2_empty:
                    break
            if c1_empty or c2_empty:
                res.append(Line.ByStartPointEndPoint(p, points[j]))
                #res.append(c1_empty)
    return res
    #return alphaDist



# Assign your output to the OUT variable.
OUT = concave_hull(points, alpha)
# ----------------------------------------

byCurve = ModelCurve.ByCurve(curve=concave_hull)

# group: Common Data Input
n2_1_lean_두께를_입력해주세요_m_팀표준_약자_c1 = DoubleInput(0.05)  # "[2.1] Lean 두께를 입력해주세요. (m) - 팀표준 약자 : C1"
n2_2_base_두께를_입력해주세요_m_팀표준_약자_c2 = DoubleInput(0.1)  # "[2.2] Base 두께를 입력해주세요. (m) - 팀표준 약자 : C2"
n2_3_subbase_두께를_입력해주세요_m_팀표준_약자 = DoubleInput(0.1)  # "[2.3] SubBase 두께를 입력해주세요. (m) - 팀표준 약자 : C3"
n2_4_extraexcavation_두께를_입력해주세요_m = DoubleInput(0)  # "[2.4] ExtraExcavation 두께를 입력해주세요. (m) - 팀표준 약자 : C4"
n2_5_lean_돌출길이를_입력해주세요_m_팀표준_약자 = DoubleInput(0.1)  # "[2.5] Lean 돌출길이를 입력해주세요. (m) - 팀표준 약자 : D1"
n2_6_터파기_여유폭을_입력해주세요_m_팀표준_약자_d2 = DoubleInput(0.2)  # "[2.6] 터파기 여유폭을 입력해주세요. (m) - 팀표준 약자 : D2"

n0_실행모드_선택 = CustomSelection("토공 선택뷰로 이동", items={토공 선택뷰로 이동: "토공 선택뷰로 이동", 토공참조선작성모드: "토공참조선작성모드", 물량산출모드: "물량산출모드"})  # "[0]. 실행모드 선택"; graph input
n1_1_산출선을_선택_대상들_그룹으로_적용하시겠습니까 = CustomSelection("그룹모드", items={그룹모드: "그룹모드", 개별모드: "개별모드"})  # "[1.1] 산출선을 선택 대상들 그룹으로 적용하시겠습니까? 개별로 적용하시겠습니까?"; graph input
n1_2_토공_산출선을_생성할_대상들을_선택해_주세요 = DSModelElementsSelection()  # "[1.2] 토공 산출선을 생성할 대상들을 선택해 주세요(드래그로 가능)"; 47 picked in the model; graph input

# group: 공통정보 입력
n2_공통정보_입력 = StringInput("""------------------------
<< Lean 두께 (m) >>
C1 : 0.05
------------------------
<< Base 두께 (m) >>
C2 : 0.1
------------------------
<< SubBase 두께 (m) >>
C3 : 0.1
------------------------
<< Extra Excavation 두께 (m) >>
C4 : 0
------------------------
<< Lean 돌출길이 (m) >>
D1 : 0.1
------------------------
<< 터파기 여유폭 (m) >>
D2 : 0.2
------------------------
<< 토량환산계수 >>
VCF : 1.15
------------------------
<< 지하수위(GL 기준 음수) >>
GWL : -1
------------------------
<< 터파기각도 >
G : 1
------------------------""")  # "[2] 공통정보 입력"; graph input
공통정보_입력_파싱 = Python(IN[0]=n2_공통정보_입력)  # CPython3
# ---------- 공통정보_입력_파싱.python (85 lines) ----------
# Load the Python Standard and DesignScript Libraries
import sys
import clr
clr.AddReference('ProtoGeometry')
from Autodesk.DesignScript.Geometry import *

################Module For Functional Programing#########################
from functools import reduce
from itertools import chain
from itertools import groupby
from copy import deepcopy

curry = lambda f: lambda a, *args: (
    f(a, *args) if (len(args)) else lambda *args: f(a, *args)
)

filter, map, reduce = curry(filter), curry(map), curry(reduce)

go = lambda *args: reduce(lambda a, f: f(a), args)  ## 함수도 축약 가능 ##


def dictUpdate(dic1, dic2):
    dic1.update(dic2)
    return dic1


def dictsMerge(dics):
    res = reduce(dictUpdate, dics)
    return res


def dictDeleteKeys(dic, keys):
    for k in keys:
        del dic[k]
    return dic


def update_nested_dict(dictionary, keys, value):
    current_dict = dictionary
    for key in keys[:-1]:
        current_dict = current_dict.setdefault(key, {})
    current_dict[keys[-1]] = value


def flat(a):
    if isinstance(a, list):
        for i in a:
            yield from flat(i)
    else:
        yield a


def grpBy(iter, key):
    f, grpKeys, grps = key, [], []
    sorted_ = sorted(iter, key=f)
    for key, grp_data in groupby(sorted_, key=f):
        grpKeys.append(key)
        grps.append(list(grp_data))
    return grps, grpKeys


#########################################################################

# The inputs to this node will be stored as a list in the IN variables.
dataEnteringNode = IN
common_info_str = IN[0]
# Place your code below this line

def parse_commonInfo(common_info_str):
    res = common_info_str.split("\n")
    
    res = go(
        common_info_str,
        lambda x: x.split("\n"),
        map(lambda x: x.strip()),
        filter(lambda x: "---" not in x),
        filter(lambda x: "<" not in x),
        map(lambda x: x.split(":")),
        map(lambda x: float(x[-1])),
    )
    
    return res

# Assign your output to the OUT variable.
OUT = parse_commonInfo(common_info_str)
# ----------------------------------------
code_block_7 = CodeBlock(i=공통정보_입력_파싱) { i[0]; i[1]; i[2]; i[3]; i[4]; i[5]; i[6]; i[7]; i[8]; }

join = List.Join(list0=code_block_7.out0, list1=code_block_7.out1, list2=code_block_7.out2, list3=code_block_7.out3)
sum = Math.Sum(values=join)
code_block_8 = CodeBlock { 1000; }
mul = sum * code_block_8
code_block_9 = CodeBlock { -1; }
mul_2 = mul * code_block_9
join_2 = List.Join(list0=code_block_7.out4, list1=code_block_7.out5)
sum_2 = Math.Sum(values=join_2)
code_block_10 = CodeBlock { 1000; }
mul_3 = sum_2 * code_block_10
code_block_11 = CodeBlock(i=mul_3) { i; }
get_geometry_byMode = Python(IN[0]=n0_실행모드_선택, IN[1]=n1_1_산출선을_선택_대상들_그룹으로_적용하시겠습니까, IN[2]=n1_2_토공_산출선을_생성할_대상들을_선택해_주세요, IN[3]=mul_2, IN[4]=code_block_11)  # CPython3
# ---------- get_geometry_byMode.python (173 lines) ----------
# Load the Python Standard and DesignScript Libraries
import sys
import clr
# Add Revit API references
clr.AddReference("RevitAPI")
clr.AddReference("RevitServices")
clr.AddReference('ProtoGeometry')
from Autodesk.DesignScript.Geometry import *
from Autodesk.Revit.DB import *
from RevitServices.Persistence import DocumentManager
from RevitServices.Transactions import TransactionManager


import Revit
clr.ImportExtensions(Revit.Elements)
clr.ImportExtensions(Revit.GeometryConversion)
# Document and UI setup
doc = DocumentManager.Instance.CurrentDBDocument
################Module For Functional Programing#########################
from functools import reduce
from itertools import chain
from itertools import groupby
from copy import deepcopy

curry = lambda f: lambda a, *args: (
    f(a, *args) if (len(args)) else lambda *args: f(a, *args)
)

filter, map, reduce = curry(filter), curry(map), curry(reduce)

go = lambda *args: reduce(lambda a, f: f(a), args)  ## 함수도 축약 가능 ##


def dictUpdate(dic1, dic2):
    dic1.update(dic2)
    return dic1


def dictsMerge(dics):
    res = reduce(dictUpdate, dics)
    return res


def dictDeleteKeys(dic, keys):
    for k in keys:
        del dic[k]
    return dic


def update_nested_dict(dictionary, keys, value):
    current_dict = dictionary
    for key in keys[:-1]:
        current_dict = current_dict.setdefault(key, {})
    current_dict[keys[-1]] = value


def flat(a):
    if isinstance(a, list):
        for i in a:
            yield from flat(i)
    else:
        yield a


def grpBy(iter, key):
    f, grpKeys, grps = key, [], []
    sorted_ = sorted(iter, key=f)
    for key, grp_data in groupby(sorted_, key=f):
        grpKeys.append(key)
        grps.append(list(grp_data))
    return grps, grpKeys


#########################################################################

def get_geom_elem(mode, elems):
    res = []
    tmp = []
    if refLine_mode=="그룹모드":
        for elem in elems:
            tmp.append(elem.Geometry()[0])
        res.append(tmp)
    if refLine_mode=="개별모드":
        for elem in elems:
            res.append(elem.Geometry())
    
    return res
    
def get_btm_srf(geom):
    filter_rule = lambda srf: go(
        srf,
        lambda x: x.NormalAtParameter(0,0),
        lambda x: x.Z,
        lambda z: z==-1,
    )

    res = go(
        geom,
        lambda x: x.Explode(),
        filter( filter_rule ),
        list,
    )
    
    return res

#to convert point
def feet_to_m(a,b,c):
    k=0.3048
    return XYZ(a/k,b/k,c/k)

# The inputs to this node will be stored as a list in the IN variables.
dataEnteringNode = IN
exec_mode = IN[0]
refLine_mode = IN[1]
tgt_elems = IN[2]
descent_height = IN[3]
offset_gap = IN[4]

# Place your code below this line



def make_refLine_forExca(refLine_mode, tgt_elems, descent_height, offset_gap):
    all_geoms = get_geom_elem(refLine_mode, tgt_elems)
    bdCuboids = go(
        all_geoms,
        map( lambda x: BoundingBox.ByGeometry(list(x)) ),
        map( lambda x: x.ToCuboid() ),
    )
    btmSrfs = go(
        bdCuboids,
        map( get_btm_srf ),
        lambda x: chain(*x),list,
        map( lambda x: x.Translate(0,0,descent_height) ),
    )
    
    refLines = go(
        btmSrfs,
        map( lambda x: x.PerimeterCurves() ),
        map( lambda x: PolyCurve.ByJoinedCurves(x) ),
        map( lambda x: x.OffsetMany(signedDistance=offset_gap, extendCircular=False, planeNormal=None) ),
        lambda x: chain(*x),list,
        map( lambda x: x.Explode() ),
        list,
        #map( lambda x: ModelCurve. .GeometryCurve(x) ),
    )
    
    # Step 3: Create a Sketch Plane
    #sketch_plane = SketchPlane.Create(doc, Plane.CreateByNormalAndOrigin(XYZ.BasisZ, XYZ.Zero))
    
    # Step 4: Start a transaction to create the ModelCurve
    TransactionManager.Instance.EnsureInTransaction(doc)
    
    # Create the ModelCurve in Revit
    res = []
    for refLine in refLines:
        tmp = []
        for line in refLine:
            
            model_curve = Revit.Elements.ModelCurve.ByCurve(line)
            tmp.append(model_curve)
        res.append(tmp)
    # Complete the transaction    
    TransactionManager.Instance.TransactionTaskDone()
    

    
    return res
# Assign your output to the OUT variable.
if exec_mode == "토공참조선작성모드":
    OUT = make_refLine_forExca(refLine_mode, tgt_elems, descent_height, offset_gap)
else:
    OUT = 0
# ----------------------------------------
byGeometry = BoundingBox.ByGeometry(geom=get_geometry_byMode)  # frozen
toCuboid = BoundingBox.ToCuboid(boundingBox=byGeometry)
get_btm_srf = Python(IN[0]=toCuboid)  # CPython3
# ---------- get_btm_srf.python (91 lines) ----------
# Load the Python Standard and DesignScript Libraries
import sys
import clr
clr.AddReference('ProtoGeometry')
from Autodesk.DesignScript.Geometry import *

################Module For Functional Programing#########################
from functools import reduce
from itertools import chain
from itertools import groupby
from copy import deepcopy

curry = lambda f: lambda a, *args: (
    f(a, *args) if (len(args)) else lambda *args: f(a, *args)
)

filter, map, reduce = curry(filter), curry(map), curry(reduce)

go = lambda *args: reduce(lambda a, f: f(a), args)  ## 함수도 축약 가능 ##


def dictUpdate(dic1, dic2):
    dic1.update(dic2)
    return dic1


def dictsMerge(dics):
    res = reduce(dictUpdate, dics)
    return res


def dictDeleteKeys(dic, keys):
    for k in keys:
        del dic[k]
    return dic


def update_nested_dict(dictionary, keys, value):
    current_dict = dictionary
    for key in keys[:-1]:
        current_dict = current_dict.setdefault(key, {})
    current_dict[keys[-1]] = value


def flat(a):
    if isinstance(a, list):
        for i in a:
            yield from flat(i)
    else:
        yield a


def grpBy(iter, key):
    f, grpKeys, grps = key, [], []
    sorted_ = sorted(iter, key=f)
    for key, grp_data in groupby(sorted_, key=f):
        grpKeys.append(key)
        grps.append(list(grp_data))
    return grps, grpKeys


#########################################################################


# The inputs to this node will be stored as a list in the IN variables.
dataEnteringNode = IN
geoms = IN[0]
if not isinstance(geoms, list):
    geoms = [geoms]
# Place your code below this line

def get_btm_srf(geom):
    filter_rule = lambda srf: go(
        srf,
        lambda x: x.NormalAtParameter(0,0),
        lambda x: x.Z,
        lambda z: z==-1,
    )

    res = go(
        geom,
        lambda x: x.Explode(),
        filter( filter_rule ),
    )
    
    return res



# Assign your output to the OUT variable.
OUT = map(get_btm_srf, geoms)
# ----------------------------------------
translate_2 = Geometry.Translate(geometry=get_btm_srf, zTranslation=mul_2)
perimeterCurves = Surface.PerimeterCurves(surface=translate_2)
byJoinedCurves = PolyCurve.ByJoinedCurves(curves=perimeterCurves)
boolean = BoolSelector(false)
offsetMany = PolyCurve.OffsetMany(polyCurve=byJoinedCurves, signedDistance=code_block_11, extendCircular=boolean)
explode = Geometry.Explode(geometry=offsetMany)
byCurve_2 = ModelCurve.ByCurve(curve=explode)
parameters = Element.Parameters(element=byCurve_2)
n3_1_vcf_토량환산계수를_입력해주세요_팀표준_약자 = DoubleInput(1.15)  # "[3.1] VCF 토량환산계수를 입력해주세요. - 팀표준 약자 : VCF"
n3_2_지하수위를_입력해주세요_팀표준_약자_gwl = DoubleInput(-1)  # "[3.2] 지하수위를 입력해주세요. - 팀표준 약자 : GWL"
n3_3_터파기각도를_입력해주세요_팀표준_약자_g = DoubleInput(1)  # "[3.3] 터파기각도를 입력해주세요. - 팀표준 약자 : G"
categories = Categories("OST_Lines")

# group: 모델라인만 검출
all_elements_of_category = ElementsOfCategory(Category=categories)
code_block_12 = CodeBlock { "Detail Line"; }
getParameterValueByName = Element.GetParameterValueByName(element=all_elements_of_category, parameterName=code_block_12)
code_block_13 = CodeBlock(i=getParameterValueByName) { i==0?true:false; }
filterByBoolMask = List.FilterByBoolMask(list=all_elements_of_category, mask=code_block_13)

parameters_2 = Element.Parameters(element=all_elements_of_category)
levels = Levels("HPP")
elevation = Level.Elevation(level=levels)

# group: GWL 높이
code_block_14 = CodeBlock(i=code_block_7.out7) { i*1000; }
code_block_15 = CodeBlock(gl_elev=elevation) { gl_elev; }
add = code_block_14 + code_block_15

code_block_16 = CodeBlock(하강높이=mul) { 하강높이; }
getLocation_2 = Element.GetLocation(element=filterByBoolMask.in)  # frozen
byJoinedCurves_2 = PolyCurve.ByJoinedCurves(curves=getLocation_2)
code_block_17 = CodeBlock(gl_elev=elevation) { gl_elev; }
startPoint = Curve.StartPoint(curve=getLocation_2)
Z_2 = Point.Z(point=startPoint)
minimumItem = List.MinimumItem(list=Z_2)
code_block_18 = CodeBlock(gl=code_block_17, b=minimumItem) { gl - (b); }
translate_3 = Geometry.Translate(geometry=byJoinedCurves_2, zTranslation=code_block_18)
code_block_19 = CodeBlock(G=code_block_7.out8) { G; }
code_block_20 = CodeBlock(L=code_block_18, G=code_block_19) { 상부오프셋 = L * G; }
offsetMany_2 = Curve.OffsetMany(curve=translate_3, signedDistance=code_block_20)
list_create_2 = List.Create(item0=offsetMany_2, item1=byJoinedCurves_2)
byLoft = Solid.ByLoft(crossSections=list_create_2)

# group: Excavation Target Select 뷰로 이동
code_block_21 = CodeBlock { "3D_AR_for Excavation Target Select"; }
earth_view_열기 = Python(IN[0]=code_block_21)  # CPython3
# ---------- earth_view_열기.python (33 lines) ----------
# Import required Revit API and services
import clr
clr.AddReference("RevitAPI")
clr.AddReference("RevitServices")
clr.AddReference("RevitNodes")

from Autodesk.Revit.DB import *
from RevitServices.Persistence import DocumentManager
from RevitServices.Transactions import TransactionManager

# Get the active document and UIDocument
uiapp = DocumentManager.Instance.CurrentUIApplication
uidoc = uiapp.ActiveUIDocument
doc = DocumentManager.Instance.CurrentDBDocument

# Input: View name from Dynamo
view_name = IN[0]  # View name (string) to open

# Find the view by name
views = FilteredElementCollector(doc).OfClass(View).ToElements()
target_view = None

for view in views:
    if view.Name == view_name and not view.IsTemplate:  # Ignore view templates
        target_view = view
        break

# Open the view if it exists
if target_view:
    uidoc.RequestViewChange(target_view)  # Opens the target view
    OUT = "View opened: {}".format(view_name)
else:
    OUT = "View not found: {}".format(view_name)
# ----------------------------------------
