# Dynamo graph [H_PAB.RT.Q2]_Revit 물량 산출_[3.0.0]_mk.dyn (Dynamo 2.16.1.2727)
# author: MK Jang
# Auto Calculating the Quantities of each Element As per the Family List

물량산출모드_입찰_실행 = CustomSelection("실행", items={입찰: "입찰", 실행: "실행"})  # graph input

# group: All Elements in Revit
categories = Categories("OST_Rooms")
all_elements_of_category = ElementsOfCategory(Category=categories)
all_elementsexceptrails = Python()  # CPython3; unwired: IN[0]
# ---------- all_elementsexceptrails.python (51 lines) ----------
# Load the Python Standard and DesignScript Libraries
import sys
import clr
clr.AddReference('ProtoGeometry')
from Autodesk.DesignScript.Geometry import *

clr.AddReference('RevitAPI')
from Autodesk.Revit.DB import *
import Autodesk

clr.AddReference('RevitServices')
import RevitServices
from RevitServices.Persistence import DocumentManager
doc = DocumentManager.Instance.CurrentDBDocument

def get_all_BIC():

    db = [
    Autodesk.Revit.DB.BuiltInCategory.OST_Floors,
    Autodesk.Revit.DB.BuiltInCategory.OST_Roofs,
    Autodesk.Revit.DB.BuiltInCategory.OST_Walls,
    Autodesk.Revit.DB.BuiltInCategory.OST_StructuralFoundation,
    Autodesk.Revit.DB.BuiltInCategory.OST_StructuralColumns,
    Autodesk.Revit.DB.BuiltInCategory.OST_StructuralFraming,
    Autodesk.Revit.DB.BuiltInCategory.OST_Ceilings,
    Autodesk.Revit.DB.BuiltInCategory.OST_Doors,
    Autodesk.Revit.DB.BuiltInCategory.OST_Windows,
    Autodesk.Revit.DB.BuiltInCategory.OST_Stairs,
    #Autodesk.Revit.DB.BuiltInCategory.OST_Railings,
    ]
    return db
    
def get_allElems(doc):
    bics = get_all_BIC()
    
    def getElems(x):
        collector = FilteredElementCollector(doc)
        res = collector.OfCategory(x).WhereElementIsNotElementType().ToElements()
        return res

    def getRailElems(x):
        collector = FilteredElementCollector(doc)
        res = collector.OfCategory(x).WhereElementIsNotElementType()
        return res

    res = map(getElems, bics)
#    res = getRailElems(Autodesk.Revit.DB.BuiltInCategory.OST_RailingSystemRail)
    return res


OUT = get_allElems(doc)
# ----------------------------------------
categories_2 = Categories("OST_StairsRailing")
all_elements_of_category_2 = ElementsOfCategory(Category=categories_2)
list_create = List.Create(item0=all_elements_of_category_2)
categories_3 = Categories("OST_GenericModel")
all_elements_of_category_3 = ElementsOfCategory(Category=categories_3)
type = Object.Type(object=all_elements_of_category_3)
code_block = CodeBlock(i=type) { i!="Revit.Elements.DirectShape"; }
filterByBoolMask = List.FilterByBoolMask(list=all_elements_of_category_3, mask=code_block)
list_create_2 = List.Create(item0=filterByBoolMask.in)
join = List.Join(list0=all_elements_of_category, list1=all_elementsexceptrails, list2=list_create, list3=list_create_2)

code_block_2 = CodeBlock { "IfcGUID"; }
getParameterValueByName = Element.GetParameterValueByName(element=join, parameterName=code_block_2)
parameters = Element.Parameters(element=join)
code_block_3 = CodeBlock(i=join) { i[3]; }
parameters_2 = Element.Parameters(element=code_block_3)
