# Dynamo graph 공통(_)_Elements Filtering_2.0.1_mk.dyn (Dynamo 2.16.1.2727)
# author: MK Jang
# Filtering Elements by given condition and Isolating them in view

n0_target_view = Views("{3D}")  # "0. Target View"; graph input

# group: All Elements in Revit
all_elementsexceptrails = Python()  # CPython3; unwired: IN[0]
# ---------- all_elementsexceptrails.python (52 lines) ----------
# Load the Python Standard and DesignScript Libraries
import sys
import clr
clr.AddReference('ProtoGeometry')
from Autodesk.DesignScript.Geometry import *

clr.AddReference('RevitAPI')
from Autodesk.Revit.DB import *
import Autodesk

clr.AddReference('RevitServices')
import RevitServices
from RevitServices.Persistence import DocumentManager


def get_all_BIC():

    db = [
    Autodesk.Revit.DB.BuiltInCategory.OST_Floors,
    Autodesk.Revit.DB.BuiltInCategory.OST_Roofs,
    Autodesk.Revit.DB.BuiltInCategory.OST_Walls,
    Autodesk.Revit.DB.BuiltInCategory.OST_StructuralFoundation,
    Autodesk.Revit.DB.BuiltInCategory.OST_StructuralColumns,
    Autodesk.Revit.DB.BuiltInCategory.OST_StructuralFraming,
    Autodesk.Revit.DB.BuiltInCategory.OST_Ceilings,
    Autodesk.Revit.DB.BuiltInCategory.OST_Doors,
    Autodesk.Revit.DB.BuiltInCategory.OST_Windows,
    Autodesk.Revit.DB.BuiltInCategory.OST_Stairs,
    #Autodesk.Revit.DB.BuiltInCategory.OST_Railings,
    ]
    return db
    
def get_allElems():
    doc = DocumentManager.Instance.CurrentDBDocument
    bics = get_all_BIC()
    
    def getElems(x):
        collector = FilteredElementCollector(doc)
        res = collector.OfCategory(x).WhereElementIsNotElementType().ToElements()
        return res

    def getRailElems(x):
        collector = FilteredElementCollector(doc)
        res = collector.OfCategory(x).WhereElementIsNotElementType()
        return res

    res = map(getElems, bics)
#    res = getRailElems(Autodesk.Revit.DB.BuiltInCategory.OST_RailingSystemRail)
    return res


OUT = get_allElems()
# ----------------------------------------
categories = Categories("OST_StairsRailing")
all_elements_of_category = ElementsOfCategory(Category=categories)
list_create = List.Create(item0=all_elements_of_category)
join = List.Join(list0=all_elementsexceptrails, list1=list_create)
flatten = List.Flatten(list=join)

n3_키워드_판별_모드 = CustomSelection("'Or' 모드", items={'And' 모드: "0", 'Or' 모드: "1", 'Nor' 모드: "2"})  # "3. 키워드 판별 모드**"; graph input
n1_타겟_파라미터_이름 = CustomSelection("Type", items={Type: "Type", Family and Type: "Family and Type", H_Revision: "H_Revision", Mark: "Mark", Level: "Level", Comments: "Comments", IfcGUID: "IfcGUID"})  # "1. 타겟 파라미터 이름"; graph input
getParamValueByNameAsStr = Python(IN[0]=flatten, IN[1]=n1_타겟_파라미터_이름)  # CPython3
# ---------- getParamValueByNameAsStr.python (39 lines) ----------
# Load the Python Standard and DesignScript Libraries
import sys
import clr
clr.AddReference('ProtoGeometry')
from Autodesk.DesignScript.Geometry import *

import Revit


# The inputs to this node will be stored as a list in the IN variables.
dataEnteringNode = IN

allElems = IN[0]
inputParamName = IN[1]
# Place your code below this line
def getParamValueByNameAsStr(elem, inputParamName):
    allParam = elem.Parameters
    allParamNames = list(map(lambda x: x.Name, allParam))
    if inputParamName in allParamNames and str(allParam[allParamNames.index(inputParamName)]).split(':')[-1] != "":
        targetIdx = allParamNames.index(inputParamName)
        res = str(allParam[targetIdx])
    elif inputParamName == "Level" and "Reference Level" in allParamNames:
        targetIdx = allParamNames.index("Reference Level")
        res = str(allParam[targetIdx])
    elif inputParamName == "Level" and "Base Level" in allParamNames:
        targetIdx = allParamNames.index("Base Level")
        res = str(allParam[targetIdx])
    elif inputParamName == "Level" and "Base Constraint" in allParamNames:
        targetIdx = allParamNames.index("Base Constraint")
        res = str(allParam[targetIdx])
    else:
        res = ""
    
    return res

res = map(lambda x: getParamValueByNameAsStr(x, inputParamName), allElems)
# Assign your output to the OUT variable.

OUT = res
# ----------------------------------------
n2_포함여부_확인_문자열 = StringInput("S15")  # "2. 포함여부 확인 문자열"; graph input
code_block = CodeBlock()
# ---------- code_block.designscript (5 lines) ----------
[
"\r\n",
"\n",
"\r"
];
# ----------------------------------------
확인_문자열_split = Python(IN[0]=n2_포함여부_확인_문자열, IN[1]=code_block)  # CPython3
# ---------- 확인_문자열_split.python (25 lines) ----------
# Load the Python Standard and DesignScript Libraries
import sys
import clr
clr.AddReference('ProtoGeometry')
from Autodesk.DesignScript.Geometry import *

# The inputs to this node will be stored as a list in the IN variables.
dataEnteringNode = IN
inStr = IN[0]
seps = IN[1]
# Place your code below this line
def replace_lineChar(seps, inStr):
    res = inStr
    for sep in seps:
        res = res.replace(sep, ',')
    return res
inStr_replaced = replace_lineChar(seps, inStr)
split_res = map(lambda x: x.strip(), inStr_replaced.split(','))
#split_res = inStr
#for sep in seps:
#    split_res = split_res.split(sep)


# Assign your output to the OUT variable.
OUT = split_res
# ----------------------------------------
포함여부_판별 = Python(IN[0]=n3_키워드_판별_모드, IN[1]=getParamValueByNameAsStr, IN[2]=확인_문자열_split)  # CPython3
# ---------- 포함여부_판별.python (48 lines) ----------
# Load the Python Standard and DesignScript Libraries
import sys
import clr
clr.AddReference('ProtoGeometry')
from Autodesk.DesignScript.Geometry import *

# The inputs to this node will be stored as a list in the IN variables.
dataEnteringNode = IN
discr_mode_bln = IN[0]
elemsPropList = IN[1]
inStrList = IN[2]

# Place your code below this line
def find_IsInStr(target, str):
    if target == None or str == None:
        pass
    else:
        res = target in str
        return res


def IsContainStr(discr_mode_bln, elemsPropList, inStrList):
    elemsPropStrList = list(map(str, elemsPropList))
    if discr_mode_bln == 0:
        res = []
        for i in elemsPropStrList:
            tmp = []
            for j in inStrList:
                tmp.append(find_IsInStr(j,i))
            res.append(all(tmp))
    elif discr_mode_bln == 1:
        res = []
        for i in elemsPropStrList:
            tmp = []
            for j in inStrList:
                tmp.append(find_IsInStr(j,i))
            res.append(any(tmp))
    elif discr_mode_bln == 2:
        res = []
        for i in elemsPropStrList:
            tmp = []
            for j in inStrList:
                tmp.append(find_IsInStr(j,i))
            res.append(not(any(tmp)))
    return res

# Assign your output to the OUT variable.
OUT = IsContainStr(discr_mode_bln, elemsPropList, inStrList)
# ----------------------------------------
filterByBoolMask = List.FilterByBoolMask(list=flatten, mask=포함여부_판별)
isolateElementsTemporary = View.IsolateElementsTemporary(view=n0_target_view, elements=filterByBoolMask.in)
parameters = Element.Parameters(element=flatten)
code_block_2 = CodeBlock { "S02"; }
file_path = Filename("..\etc\_팀교육\BIM_다이나모 전문가 육성\ElemFilter.png")
file_from_path = FileObject(path=file_path)
readFromFile = Image.ReadFromFile(file=file_from_path)
watch_image = WatchImageCore(image=readFromFile)

# group: Floor And Str Columns from Revit
categories_2 = Categories("OST_StructuralColumns")
all_elements_of_category_2 = ElementsOfCategory(Category=categories_2)
categories_3 = Categories("OST_Floors")
all_elements_of_category_3 = ElementsOfCategory(Category=categories_3)

parameters_2 = Element.Parameters(element=all_elements_of_category_3)
file_path_2 = Filename("..\etc\_팀교육\BIM_다이나모 전문가 육성\test.xlsx")
code_block_3 = CodeBlock { "sheet"; }
code_block_4 = CodeBlock { 7; 1; }

# group: Calculate
code_block_5 = CodeBlock { "Area"; }
getParameterValueByName = Element.GetParameterValueByName(element=all_elements_of_category_3, parameterName=code_block_5)
code_block_6 = CodeBlock { 2; }
round = Math.Round(number=getParameterValueByName, digits=code_block_6)

boolean = BoolSelector(false)
exportToExcel = Data.ExportToExcel(filePath=file_path_2, sheetName=code_block_3, startRow=code_block_4.out0, startColumn=code_block_4.out1, data=round, overWrite=boolean, writeAsString=boolean)
