# Dynamo graph 실행_1_FamilyType Checker_2.0.0.dyn (Dynamo 2.16.1.2727)
# author: MK Jang
# Check Revit and Excel's Family Types

code_block = CodeBlock()
# ---------- code_block.designscript (6 lines) ----------
[
"Category",
"레빗 부재 유무",
"Revit에만 있는 타입",
"엑셀과 레빗에 둘다 있는 타입"
];
# ----------------------------------------
file_path_family_list = Filename("..\..\..\Hi-TALK Received\실습 (2)\02_플랜트건축팀_BIM_팀 표준 Family List_Rev.2_2024.02.26_SLAS(1).xlsx")  # graph input
file_from_path = FileObject(path=file_path_family_list)
code_block_2 = CodeBlock()
# ---------- code_block_2.designscript (16 lines) ----------
[
"WM-AR"
,"물량Param"
,"1.Floors"
,"2.Roofs"
,"3.Walls"
,"4.St Fdn"
,"5.St Col"
,"6.St Framing"
,"7.Ceilings"
,"8.Doors"
,"9.Windows"
,"10.Stairs"
,"11.Railings"
,"13.Generic"
];
# ----------------------------------------
boolean = BoolSelector(true)
importExcel = Data.ImportExcel(file=file_from_path, sheetName=code_block_2, showExcel=boolean)

# group: Types From Excel
lang_mode_영_한_select = BoolSelector(false)
excel_data = Python(IN[0]=lang_mode_영_한_select, IN[1]=importExcel, IN[2]=code_block_2)  # "Excel data dictionarizationScript"; CPython3
# ---------- excel_data.python (216 lines) ----------
# Load the Python Standard and DesignScript Libraries
import sys
import clr
clr.AddReference('ProtoGeometry')
from Autodesk.DesignScript.Geometry import *

from functools import reduce
from functools import partial

# The inputs to this node will be stored as a list in the IN variables.
dataEnteringNode = IN
lang_mode = IN[0]
wholeDatas = IN[1]
db = wholeDatas[1:]
allCatSheetsNames = IN[2][2:]

paramSheet = db[0]
allCatSheets = db[1:]

#db
# Place your code below this line
def make_UnifiedDict(dictsList):
    dicts_AllInOne = {}
    for d in dictsList:
        dict_k_v = d.items()
        for k,v in dict_k_v:
            dicts_AllInOne[k] = v
    return dicts_AllInOne

def find_IsInStr(target, str):
    if target == None or str == None:
        pass
    else:
        res = target in str
        return res
def find_range_by_columnItem(db, col_idx, sep_rule):
    tdb = list(map(lambda x: x[col_idx], db))
    last_idx_tdb = len(tdb)-1
    tdb_enum = enumerate(tdb)
    res = list(filter(lambda x: find_IsInStr(sep_rule, str(x[1])), tdb_enum))
    endidxs_tmp= list(map(lambda x: x[0]-1,res))
    endidxs_tmp.pop(0)
    endidxs = endidxs_tmp + [last_idx_tdb]
    famTypeNames = list(map(lambda x: x[1],res))
    famTypeNamesIdxs = list(map(lambda x: x[0],res))
    rangeSttIdxs = list(map(lambda x: x[0]+1,res))
    rangeEndIdxs = endidxs
    result = dict(zip(famTypeNames, zip(famTypeNamesIdxs, zip(rangeSttIdxs,rangeEndIdxs))))
    return result
    
    
def find_headersAtSheet(sheet):
    headers_sheet = map(lambda x: [x[1].replace("\n",""),x[0]], filter(lambda x: x[1] != None, enumerate(sheet[1])))
    
    return dict(headers_sheet)

def find_rangesAtSheet(sheet, hdrs_withIdx, trgt_hdr, trgt_str):
    return find_range_by_columnItem(sheet, hdrs_withIdx[trgt_hdr], trgt_str)


def get_DataOnRangesAtParamSheet(sheet):
    
    hdrs_withIdx = find_headersAtSheet(sheet)
    rangesATSheet = find_rangesAtSheet(sheet, hdrs_withIdx, "Q'ty Cal Type Tag", "-")
    title_idx = map(lambda x: x[0], rangesATSheet.values())
    calcType_colDatas = list(map(lambda x: x[hdrs_withIdx["Q'ty Cal Type Tag"]], sheet))
    calcTypes = list(map(lambda x: calcType_colDatas[x], title_idx))
    rgs_v = list(map(lambda x: x[1], rangesATSheet.values()))
    rgs_k = list(map(lambda x: x, rangesATSheet.keys()))
    
    hdrs_v = list(hdrs_withIdx.values())
    hdrs_k = list(hdrs_withIdx.keys())
    eff_hdrs_v = hdrs_v[2:]
    eff_hdrs_k = hdrs_k[2:]
    
    datas_allCalType = list(map(lambda x: sheet[x[0]-1:x[1]], rgs_v))
    
    def setDict_OnEachCalType(data_calType):
        paramName_lang = "패밀리 매개변수(from Revit) 영문판" if lang_mode is True else "패밀리 매개변수(from Revit) 한글판"
        calcTypeName = data_calType[0][2]
        data_calType_noneless = list(filter(lambda x: x[hdrs_withIdx["항목"]] != None, data_calType))
#        ## WM row 별 header명 과 짝짓기
        data_withHdrsIdx = list(map(lambda y: list(map(lambda x: y[x], eff_hdrs_v)), data_calType_noneless))
        dict_ = list(map(lambda x: dict(zip(eff_hdrs_k, x)), data_withHdrsIdx))
        dicts_noneless = list(map(lambda y: dict(filter(lambda x: x[1]!=None, y.items())),dict_))
#        ## dict_Cal Type 입력처리
        targetColName = "Q'ty Cal Type Tag"
        dicts_finalNoneless = []
        for d in dicts_noneless:
            d["Q'ty Cal Type Tag"] = calcTypeName
            
            if "입력값" in d.keys():
                d["applyForCalc"] = d["입력값"]
                dicts_finalNoneless.append(d)
            elif paramName_lang in d.keys():
                d["applyForCalc"] = d[paramName_lang]
                dicts_finalNoneless.append(d)
            else:
                pass
        
        return {calcTypeName: dicts_finalNoneless}
        
    return map(setDict_OnEachCalType, datas_allCalType)
    


def get_SymValDict_PerCalcType(dic):
    def findDictPerCalcType(dicList):
            dic = {}
            for i in dicList:
                dic[i["산출수식 약자"]] = i["applyForCalc"]
            return dic
    
    ks_forDic = list(dic.keys())
    vs_forDic = list(map(findDictPerCalcType, dic.values()))
    res = dict(zip(ks_forDic, vs_forDic))
    return res


def get_DataOnRangesAtCatSheet(catSheet):
    hdrs_withIdx = find_headersAtSheet(catSheet)
    rangesATSheet = find_rangesAtSheet(catSheet, hdrs_withIdx, "Family Type Name", "H_")
    title_idx = map(lambda x: x[0], rangesATSheet.values())
    calcType_colDatas = list(map(lambda x: x[hdrs_withIdx["Q'ty Cal Type Tag"]], catSheet))
    calcTypes = list(map(lambda x: calcType_colDatas[x], title_idx))
    rgs_v = list(map(lambda x: x[1], rangesATSheet.values()))
    rgs_k = list(map(lambda x: x, rangesATSheet.keys()))
    
    hdrs_v = list(hdrs_withIdx.values())
    hdrs_k = list(hdrs_withIdx.keys())
    
    datas_allFamType = list(map(lambda x: list(zip(catSheet[x[0]-1:x[1]], range(x[0]-1,x[1]))), rgs_v))
    
    def setDict_OnEachFamType(data_famType):  ## 최종적으로 산출식 없는 것 걸러내기 추가해야 함
        titleData = list(data_famType).pop(0)[0]
        
        famTypeName = titleData[hdrs_withIdx["Family Type Name"]]
        calcTypeName = titleData[hdrs_withIdx["Q'ty Cal Type Tag"]]
        data_famType_noneless = list(filter(lambda x: x[0][5] != None, data_famType))
        ## WM row 별 header명 과 짝짓기
        data_withHdrsIdx = list(map(lambda y: [list(map(lambda x: y[0][x], hdrs_v)), y[1]], data_famType_noneless))
        hdrs_k.append("rIDX")
        dict_ = list(map(lambda x: dict(zip(hdrs_k, x[0]+[x[1]])), data_withHdrsIdx))
        dicts_noneless = list(map(lambda y: dict(filter(lambda x: x[1]!=None, y.items())),dict_))
        ## dict_gauge, 물량산출식 없는 항목 처리
        dicts_final = []
        needDefault_ColName = "Gauge Code"
        noneRemove_ColName = "Dynamo 물량산출식"
        for d in dicts_noneless:
            d["Family Type Name"] = famTypeName
            
            if calcTypeName == None:
                pass            
            elif noneRemove_ColName in d.keys():
                d["Q'ty Cal Type Tag"] = calcTypeName
                d[needDefault_ColName] = ""
                dicts_final.append(d)

        return dicts_final
        
    dicts_allFamType = list(map(lambda x: setDict_OnEachFamType(list(x)), datas_allFamType))
    ds_famTypesAtCatSheet = dict(zip(rgs_k, dicts_allFamType))
    ds_famTypesAtCatSheet_effCalcType = dict(filter(lambda x: all(list(map(lambda i: "Q'ty Cal Type Tag" in i, x[1]))), list(ds_famTypesAtCatSheet.items())))
    ds_famTypesAtCatSheet_noneless = dict(filter(lambda x: len(list(x[1]))!=0, list(ds_famTypesAtCatSheet_effCalcType.items())))
    
    return  ds_famTypesAtCatSheet_noneless

def make_AIOdic(allCatSheets):

    dataOnRanges_allCat = list(map(get_DataOnRangesAtCatSheet, allCatSheets))
    dataOnRanges_allCat_WithCatNames = list(zip(allCatSheetsNames, dataOnRanges_allCat))
    
    AIOdic = {}
    for d in dataOnRanges_allCat_WithCatNames:
        catName = d[0]
        dict_k_v = d[1].items()
        for k,v in dict_k_v:
            for wm in v:
                wm["SheetName"] = catName
            AIOdic[k] = v
    return AIOdic



def matchWith_paramDic(catSheetDic, paramSheetDic):
    headers = list(catSheetDic.values())[0][0].keys()
    wmspec_headers = list(filter(lambda x: "Work C" in x or "Spec" in x, headers))
    res = {}
    for famType,diclist in catSheetDic.items():
        new_diclist = []
        for d in diclist:
            new_d = {}
            keys = d.keys()
            keys_new = set(keys) - set(wmspec_headers)
            calcType = d["Q'ty Cal Type Tag"]
            new_d["Sym_Val Dict"] = paramSheetDic[calcType]
            new_d["wmSpecs"] = list(map(lambda x: d[x],wmspec_headers))
            for spec in keys_new:
                new_d[spec] = d[spec]
            new_diclist.append(new_d)
        
        res[famType] = new_diclist
        
    return res

calcTypeDictsList = get_DataOnRangesAtParamSheet(paramSheet)
calcTypeDict = make_UnifiedDict(calcTypeDictsList)
paramSheetDic = get_SymValDict_PerCalcType(calcTypeDict) 

catSheetDic = make_AIOdic(allCatSheets)
catFam_paramDic = matchWith_paramDic(catSheetDic, paramSheetDic)

# Assign your output to the OUT variable.

#OUT = [catFam_paramDic,paramSheetDic, catSheetDic]
OUT = catSheetDic
# ----------------------------------------
values = DesignScript.Builtin.Dictionary.Values(dictionary=excel_data)
code_block_3 = CodeBlock { "SheetName"; }
valueAtKey = DesignScript.Builtin.Dictionary.ValueAtKey(dictionary=values, key=code_block_3)
uniqueItems = List.UniqueItems(list=valueAtKey@L2)
flatten = List.Flatten(list=uniqueItems)
uniqueItems_2 = List.UniqueItems(list=flatten)
code_block_4 = CodeBlock { "."; }
split = String.Split(string=uniqueItems_2, separator0=code_block_4)
firstItem = List.FirstItem(list=split@L2)
toNumber = String.ToNumber(string=firstItem)
sortByKey = List.SortByKey(list=uniqueItems_2, keys=toNumber)
keys = DesignScript.Builtin.Dictionary.Keys(dictionary=excel_data)
groupByKey = List.GroupByKey(list=keys, keys=flatten)
byKeysValues = DesignScript.Builtin.Dictionary.ByKeysValues(keys=groupByKey.uniqueKeys, values=groupByKey.groups)
valueAtKey_2 = DesignScript.Builtin.Dictionary.ValueAtKey(dictionary=byKeysValues, key=sortByKey.sortedList)

# group: 결과 리스트 formating을 위한 빈문자열 리스트
code_block_5 = CodeBlock { ""; }
code_block_6 = CodeBlock(sortedCatNames=sortByKey.sortedList) { sortedCatNames; }
addItemToEnd = List.AddItemToEnd(item=code_block_5, list=code_block_6@L1)
addItemToEnd_2 = List.AddItemToEnd(item=code_block_5, list=addItemToEnd@L2)
addItemToEnd_3 = List.AddItemToEnd(item=code_block_5, list=addItemToEnd_2@L2)

# group: 사용된 모든 부재 파악
all_elementsexceptrails = Python()  # CPython3; unwired: IN[0]
# ---------- all_elementsexceptrails.python (51 lines) ----------
# Load the Python Standard and DesignScript Libraries
import sys
import clr
clr.AddReference('ProtoGeometry')
from Autodesk.DesignScript.Geometry import *

clr.AddReference('RevitAPI')
from Autodesk.Revit.DB import *
import Autodesk

clr.AddReference('RevitServices')
import RevitServices
from RevitServices.Persistence import DocumentManager
doc = DocumentManager.Instance.CurrentDBDocument

def get_all_BIC():

    db = [
    Autodesk.Revit.DB.BuiltInCategory.OST_Floors,
    Autodesk.Revit.DB.BuiltInCategory.OST_Roofs,
    Autodesk.Revit.DB.BuiltInCategory.OST_Walls,
    Autodesk.Revit.DB.BuiltInCategory.OST_StructuralFoundation,
    Autodesk.Revit.DB.BuiltInCategory.OST_StructuralColumns,
    Autodesk.Revit.DB.BuiltInCategory.OST_StructuralFraming,
    Autodesk.Revit.DB.BuiltInCategory.OST_Ceilings,
    Autodesk.Revit.DB.BuiltInCategory.OST_Doors,
    Autodesk.Revit.DB.BuiltInCategory.OST_Windows,
    Autodesk.Revit.DB.BuiltInCategory.OST_Stairs,
    #Autodesk.Revit.DB.BuiltInCategory.OST_Railings,
    ]
    return db
    
def get_allElems(doc):
    bics = get_all_BIC()
    
    def getElems(x):
        collector = FilteredElementCollector(doc)
        res = collector.OfCategory(x).WhereElementIsNotElementType().ToElements()
        return res

    def getRailElems(x):
        collector = FilteredElementCollector(doc)
        res = collector.OfCategory(x).WhereElementIsNotElementType()
        return res

    res = map(getElems, bics)
#    res = getRailElems(Autodesk.Revit.DB.BuiltInCategory.OST_RailingSystemRail)
    return res


OUT = get_allElems(doc)
# ----------------------------------------
categories = Categories("OST_StairsRailing")
all_elements_of_category = ElementsOfCategory(Category=categories)
code_block_7 = CodeBlock { 10; }
insert = List.Insert(list=all_elementsexceptrails, element=all_elements_of_category, index=code_block_7)
elementType = Element.ElementType(element=insert)
name = FamilyType.Name(familyType=elementType)
flatten_2 = List.Flatten(list=name)

# group: Types From Revit
allFamilyTypesPerCat = Python()  # CPython3; unwired: IN[0]
# ---------- allFamilyTypesPerCat.python (60 lines) ----------
# Load the Python Standard and DesignScript Libraries
import sys
import clr
clr.AddReference('ProtoGeometry')
from Autodesk.DesignScript.Geometry import *

import DSRevitNodesUI

clr.AddReference('RevitNodes')
import Revit
clr.ImportExtensions(Revit.Elements)
from Revit import Elements

clr.AddReference('RevitAPI')
from Autodesk.Revit.DB import *
import Autodesk

clr.AddReference('RevitServices')
import RevitServices
from RevitServices.Persistence import DocumentManager
doc = DocumentManager.Instance.CurrentDBDocument
#collector = FilteredElementCollector(doc)

# The inputs to this node will be stored as a list in the IN variables.
dataEnteringNode = IN

# Place your code below this line
#res = collector.OfCategory(BuiltInCategory.OST_Floors).WhereElementIsElementType().ToElements()


def getAllTypes(n):
    collector = FilteredElementCollector(doc)
    bics = [
        BuiltInCategory.OST_Floors, BuiltInCategory.OST_Roofs,
        BuiltInCategory.OST_Walls, BuiltInCategory.OST_StructuralFoundation,
        BuiltInCategory.OST_StructuralColumns, BuiltInCategory.OST_StructuralFraming,
        BuiltInCategory.OST_Ceilings, BuiltInCategory.OST_Doors,
        BuiltInCategory.OST_Windows, BuiltInCategory.OST_Stairs,
        BuiltInCategory.OST_StairsRailing,
        BuiltInCategory.OST_GenericModel
        ]
        
        
    allFamTypes = collector.OfCategory(bics[n]).WhereElementIsElementType().ToElements()
    
    return allFamTypes
    
def getAllRailingTypes():
    collector = FilteredElementCollector(doc)      
    allFamTypes = collector.OfCategory(BuiltInCategory.OST_StairsRailing).ToElements()
    
    return allFamTypes
    

# Assign your output to the OUT variable.
#OUT = dir(Elements.FloorType)
#OUT = list(map(lambda x: x.WhereElementIsElementType().ToElements(), allCollector))
rgs = range(12)
res = list(map(getAllTypes, rgs))
OUT = res
# ----------------------------------------

code_block_8 = CodeBlock(i=allFamilyTypesPerCat) { i; }
name_2 = FamilyType.Name(familyType=code_block_8)
empty_list_처리기 = Python(IN[0]=name_2)  # CPython3
# ---------- empty_list_처리기.python (17 lines) ----------
# Load the Python Standard and DesignScript Libraries
import sys
import clr
clr.AddReference('ProtoGeometry')
from Autodesk.DesignScript.Geometry import *

# The inputs to this node will be stored as a list in the IN variables.
dataEnteringNode = IN
grpsList = IN[0]
# Place your code below this line
def treat_grp(grp):
    if len(grp) != 0:
        return grp
    else:
        return ["!!! 작성된 타입 없음 !!!"]
# Assign your output to the OUT variable.
OUT = list(map(treat_grp, grpsList))
# ----------------------------------------
contains = List.Contains(list=flatten_2, item=empty_list_처리기@@L1)
code_block_9 = CodeBlock { "모델링 O"; "모델링 X"; }
if_ = RefactoredIf(test=contains, true=code_block_9.out0, false=code_block_9.out1)
from_revit = CodeBlock(i=empty_list_처리기) { i; }
addItemToFront = List.AddItemToFront(item=if_@L1, list=from_revit@@L1)
from_excel = CodeBlock(j=valueAtKey_2) { j; }
make_pairdictlist = Python(IN[0]=addItemToFront, IN[1]=from_excel)  # CPython3
# ---------- make_pairdictlist.python (23 lines) ----------
# Load the Python Standard and DesignScript Libraries
import sys
import clr
clr.AddReference('ProtoGeometry')
from Autodesk.DesignScript.Geometry import *

# The inputs to this node will be stored as a list in the IN variables.
dataEnteringNode = IN

rvtTypesGrps = IN[0]
exlTypesGrps = IN[1]
# Place your code below this line

def chk_sameTypes_byCat(args):
#    rvtModel = list(map(lambda x: x[1], filter(lambda x: x not in exlTypes, rvtTypes)))
    rvtTypes = args[0]
    exlTypes = args[1]
    rvtOnly = list(filter(lambda x: x[1] not in exlTypes, rvtTypes))
    both = list(filter(lambda x: x[1] in exlTypes, rvtTypes))
    return {"RvtOnly": rvtOnly, "Both": both}
inputsPairs = list(zip(rvtTypesGrps,exlTypesGrps))
# Assign your output to the OUT variable.
OUT = list(map(lambda x: chk_sameTypes_byCat(x), inputsPairs))
# ----------------------------------------
formatting_for_excel = Python(IN[0]=make_pairdictlist)  # CPython3
# ---------- formatting_for_excel.python (35 lines) ----------
# Load the Python Standard and DesignScript Libraries
import sys
import clr
clr.AddReference('ProtoGeometry')
from Autodesk.DesignScript.Geometry import *

# The inputs to this node will be stored as a list in the IN variables.
dataEnteringNode = IN
pairDictsList = IN[0]
# Place your code below this line

def makeTypesList(pairDictsList):
    res = []
    for catD in pairDictsList:
        tmp = []
        if catD["RvtOnly"]==[] and catD["Both"]==[]:
            tmp.append(["","","",""])
        elif catD["RvtOnly"] != [] and catD["Both"]==[]:
            for i in catD["RvtOnly"]:
                tmp.append(["",i[0],i[1],""])
        elif catD["RvtOnly"] == [] and catD["Both"]!=[]:
            for i in catD["Both"]:
                tmp.append(["",i[0],"",i[1]])
        else:
            for i in catD["RvtOnly"]:
                tmp.append(["",i[0],i[1],""])
            for j in catD["Both"]:
                tmp.append(["",j[0],"",j[1]])
        res.append(tmp)
    
    return res

# Assign your output to the OUT variable.
#OUT = format_byRow(makeTypesList(pairDictsList))
OUT = makeTypesList(pairDictsList)
# ----------------------------------------
addItemToFront_2 = List.AddItemToFront(item=addItemToEnd_3@L2, list=formatting_for_excel@L3)
flatten_3 = List.Flatten(list=addItemToFront_2@L2)
addItemToFront_3 = List.AddItemToFront(item=code_block, list=flatten_3)

# group: Get PJT & Building Name
code_block_10 = CodeBlock { " - "; }
categories_2 = Categories("OST_ProjectInformation")
all_elements_of_category_2 = ElementsOfCategory(Category=categories_2)
firstItem_2 = List.FirstItem(list=all_elements_of_category_2)
code_block_11 = CodeBlock()
# ---------- code_block_11.designscript (5 lines) ----------
[
//"Project Name",
"H_Project Abbreviation",
"Building Name"
];
# ----------------------------------------
getParameterValueByName = Element.GetParameterValueByName(element=firstItem_2, parameterName=code_block_11)
join = String.Join(separator=code_block_10, string0=getParameterValueByName)
firstItem_3 = List.FirstItem(list=join)

# group: HTML Export
javascriptPart = Python()  # CPython3; unwired: IN[0]
# ---------- javascriptPart.python (44 lines) ----------
# Load the Python Standard and DesignScript Libraries
import sys
import clr
clr.AddReference('ProtoGeometry')
from Autodesk.DesignScript.Geometry import *

# The inputs to this node will be stored as a list in the IN variables.
dataEnteringNode = IN

# Place your code below this line
jsPart = '''
function btn(){
    alert('버튼이 클릭되었습니다');
}

function insertPathStr() {
    var path_ = window.location.pathname;
    var lastIdx = path_.lastIndexOf('/');
    var pathStr = path_.substring(1, lastIdx);
    var pathArea = document.getElementById('pathArea');
    
    var newPathDiv = document.createElement("div");
    newPathDiv.setAttribute('id','folderPath');
    newPathDiv.innerHTML = pathStr;
    pathArea.prepend(newPathDiv);
    //return path_;
    //console.log(path_)
  }
insertPathStr()

function copyPathHandler() {
    var strs = document.getElementById('folderPath').innerText;
    const el = document.createElement('textarea');
    el.value = strs;
    el.setAttribute('readonly', '');
    document.body.appendChild(el);
    el.select();
    document.execCommand('copy');
    document.body.removeChild(el);
    alert(' 파일이 저장된 경로가 복사되었습니다 ! \\n (탐색기에 붙여넣으시면 폴더로 바로 이동할 수 있습니다.)');
  }
'''
# Assign your output to the OUT variable.
OUT = jsPart
# ----------------------------------------
cssPart = Python()  # CPython3; unwired: IN[0]
# ---------- cssPart.python (93 lines) ----------
# Load the Python Standard and DesignScript Libraries
import sys
import clr
clr.AddReference('ProtoGeometry')
from Autodesk.DesignScript.Geometry import *

# The inputs to this node will be stored as a list in the IN variables.
dataEnteringNode = IN

# Place your code below this line
cssPart = '''
#pathArea {
text-align: flex;
}

#folderPath {
display: inline-block;
vertical-align: 0px;
width: auto;
}

#fpathBtn {
display: inline-block;
width: auto;
vertical-align: middle;
}

table {
border-collapse: collapse;
width: 100%;
}

th {
text-align: center;
}

th, td {
padding: 10px;
border-bottom: 1px solid #E2E2E2;
}

td {
border-right: 1px solid #E2E2E2;
}

/* 커서 갖다대면 색깔이 바뀌며 직관적으로 표현한다 */
tr:hover { background-color: #F5F5F5; }

button {
  display: block;
  position: relative;
  float: left;
  width: 100px;
  padding: 0;
  margin: 5px 5px 5px 0;
  font-weight: 600;
  text-align: center;
  line-height: 30px;
  color: #FFF;
  border-radius: 5px;
  transition: all 0.1s ;
}

.btnPurple {
  background: #A97BF5;
}

.btnPurple.btnPush {
  box-shadow: 0px 5px 0px 0px #6D184B;
}

.btnPurple.btnPush:hover {
  box-shadow: 0px 0px 0px 0px #6D184B;
}

.btnPush:hover {
  margin-top: 15px;
  margin-bottom: 5px;
}

/* BORDER */

.btnPurple.btnBorder {
  box-shadow: 0px 0px 0px 0px #6D184B;
}

.btnPurple.btnBorder:hover {
  box-shadow: 0px 0px 0px 5px #6D184B;
}

'''
# Assign your output to the OUT variable.
OUT = cssPart
# ----------------------------------------
tablePart = Python(IN[0]=addItemToFront_3)  # CPython3
# ---------- tablePart.python (41 lines) ----------
# Load the Python Standard and DesignScript Libraries
import sys
import clr
clr.AddReference('ProtoGeometry')
from Autodesk.DesignScript.Geometry import *

# The inputs to this node will be stored as a list in the IN variables.
dataEnteringNode = IN
rows = IN[0]
hdr = rows[0]
# Place your code below this line
def make_th(hdr):
    preStr = "<tr>"
    postStr = "</tr>"
    hdrStrs = list(map(lambda x: f"<th>{x}</th>", hdr))
    res = "\n".join([preStr]+hdrStrs+[postStr])
    return res

def make_tr(row):
    preStr = "<tr>"
    postStr = "</tr>"
    if row[0] != "":
        rowStrs = list(map(lambda x: f"<th>{x}</th>", row))
    else:
        rowStrs = list(map(lambda x: f"<td>{x}</td>", row))
    res = "\n".join([preStr]+rowStrs+[postStr])
    return res

def make_trs(rows):
    rowsWithoutHdr = rows[1:]
    rowsStrs = list(map(make_tr, rowsWithoutHdr))
    res = "\n".join(rowsStrs)
    return res

def make_wholeTable(th,trs):
    preStr = "<table>"
    postStr = "</table>"
    res = "\n".join([preStr, th, trs, postStr])
    return res
# Assign your output to the OUT variable.
OUT = make_wholeTable(make_th(hdr), make_trs(rows))
# ----------------------------------------
make_htmlStr = Python(IN[0]=javascriptPart, IN[1]=cssPart, IN[2]=tablePart, IN[3]=firstItem_3)  # CPython3
# ---------- make_htmlStr.python (58 lines) ----------
# Load the Python Standard and DesignScript Libraries
import sys
import clr
clr.AddReference('ProtoGeometry')
from Autodesk.DesignScript.Geometry import *

# The inputs to this node will be stored as a list in the IN variables.
dataEnteringNode = IN
jsPart = IN[0]
cssPart = IN[1]
tablePart = IN[2]
##folderPath = IN[3]
pjt_bdName = IN[3]

# Place your code below this line
##folderPath_r = folderPath.replace('\\','\\\\')

htmlStr = f'''
<!DOCTYPE html>
<html lang="ko">

<head>
    <meta charset="UTF-8">
    <title>Family Types Check Result</title>
    <style>
        {cssPart}
    </style>
</head>

<body>

<h2>Family Types Check Result - Revit & Excel</h2>
<h5>Project/Building Information : {pjt_bdName}</h5>

<!--
<h5>Check Result Path : </h5>

<blockquote id="pathArea">
    
    <div id="fpathBtn"><button class="button btnBorder btnPurple" onClick="copyPathHandler()">경로 복사하기</button></div>
    
</blockquote>
-->
    
<div class="table">
    {tablePart}
</div>
    
    
<script>
    {jsPart}
</script>
</body>

</html>
'''
# Assign your output to the OUT variable.
OUT = htmlStr
# ----------------------------------------
htmlPath = Python()  # CPython3; unwired: IN[0]
# ---------- htmlPath.python (33 lines) ----------
# Load the Python Standard and DesignScript Libraries
import sys
import clr
clr.AddReference('ProtoGeometry')
from Autodesk.DesignScript.Geometry import *
import time
import subprocess
import os

clr.AddReference('RevitNodes')
import Revit
clr.ImportExtensions(Revit.Elements)
from Revit import Elements
# The inputs to this node will be stored as a list in the IN variables.
dataEnteringNode = IN

# Place your code below this line
def find_cwd():
    doc = Revit.Application.Document.Current
    filePath_string = doc.FilePath
    folderPath = filePath_string.split('\\')
    folderPath.pop(-1)
    folderPath_str = '\\'.join(folderPath)
    return folderPath_str

cwd = find_cwd()

folderPath = f"{cwd}\\.dynLog"
if not os.path.exists(folderPath):
    os.makedirs(folderPath)

# Assign your output to the OUT variable.
OUT = folderPath
# ----------------------------------------
building_name = CodeBlock(i=getParameterValueByName) { i[1]; }
create_html_file_and_open = Python(IN[0]=make_htmlStr, IN[1]=htmlPath, IN[2]=building_name)  # CPython3
# ---------- create_html_file_and_open.python (83 lines) ----------
# Load the Python Standard and DesignScript Libraries
import os
import sys
import clr
clr.AddReference('ProtoGeometry')
from Autodesk.DesignScript.Geometry import *

clr.AddReference('RevitNodes')
import Revit
clr.ImportExtensions(Revit.Elements)
from Revit import Elements

import time
import subprocess

#################################Module For Functional Programing#############################################
from functools import reduce
curry = lambda f: lambda a,*args: f(a, *args) if (len(args)) else lambda *args: f(a, *args)

filter = curry(filter)
map = curry(map)

def _take(length, iter):
    res = []
    for a in iter:
        res.append(a)
        if len(res) == length:
            return res
        
take = curry(_take)
reduce = curry(reduce)

go = lambda *args: reduce(lambda a,f: f(a), args) ## 함수도 축약 가능 ##
##############################################################################################################

# The inputs to this node will be stored as a list in the IN variables.
dataEnteringNode = IN
contents = IN[0]
folderPath = IN[1]
bdName = IN[2]
# Place your code below this line
def find_cwd():
    doc = Revit.Application.Document.Current
    filePath_string = doc.FilePath
    folderPath = filePath_string.split('\\')
    folderPath.pop(-1)
    folderPath_str = '\\'.join(folderPath)
    return folderPath_str

#cwd = find_cwd()
cwd = folderPath

def make_resultHTMLname(htmlStr,title,cwd):
    timeStamp = time.strftime('%H_%M_%S', time.localtime(time.time()))
    #folderPath = f"{cwd}\\.dynLog"
    folderPath = cwd
    if not os.path.exists(folderPath):
        os.makedirs(folderPath)
    fileName = f"{bdName}_Type Check Result.html"
    filePath = f"{folderPath}\\" + fileName
    f = open(filePath, 'w', encoding='utf8')
    f.write(htmlStr)
    f.close()
    return fileName

def execute_file(fileName):
    #cwd = find_cwd()
    folderPath = cwd
    os.chdir(folderPath)
    #cmdStr = "python -m http.server"
    #cmdList = cmdStr.split(' ')
    #subprocess.run(args=cmdList, shell=True)
    
    #subprocess.run(args=[fileName], shell=True)
    subprocess.run(args=['start','excel',fileName], shell=True)

fileName = make_resultHTMLname(contents,bdName,cwd)

execute_file(fileName)


# Assign your output to the OUT variable.
OUT = fileName.split('.')[0]
# ----------------------------------------

# group: Excel Export
make_resultFilePath = Python()  # CPython3; frozen; unwired: IN[0]
# ---------- make_resultFilePath.python (64 lines) ----------
# Load the Python Standard and DesignScript Libraries
import os
import sys
import clr
clr.AddReference('ProtoGeometry')
from Autodesk.DesignScript.Geometry import *

clr.AddReference('RevitNodes')
import Revit
clr.ImportExtensions(Revit.Elements)
from Revit import Elements

import time
import subprocess

#################################Module For Functional Programing#############################################
from functools import reduce
curry = lambda f: lambda a,*args: f(a, *args) if (len(args)) else lambda *args: f(a, *args)

filter = curry(filter)
map = curry(map)

def _take(length, iter):
    res = []
    for a in iter:
        res.append(a)
        if len(res) == length:
            return res
        
take = curry(_take)
reduce = curry(reduce)

go = lambda *args: reduce(lambda a,f: f(a), args) ## 함수도 축약 가능 ##
##############################################################################################################

# The inputs to this node will be stored as a list in the IN variables.
dataEnteringNode = IN
title = IN[0]
# Place your code below this line
def find_cwd():
    doc = Revit.Application.Document.Current
    filePath_string = doc.FilePath
    folderPath = filePath_string.split('\\')
    folderPath.pop(-1)
    folderPath_str = '\\'.join(folderPath)
    return folderPath_str

cwd = find_cwd()

def make_resultFilePath(title,cwd):
    folderPath = f"{cwd}\\.dynLog"
    if not os.path.exists(folderPath):
        os.makedirs(folderPath)
    filePath = f"{folderPath}\\{title}.xlsx"

    return filePath



result = make_resultFilePath(title, cwd)

#subprocess.run(args=["aaa.html"], shell=True)
# Assign your output to the OUT variable.
OUT = result
# ----------------------------------------
code_block_12 = CodeBlock { "Sheet1"; }
code_block_13 = CodeBlock { 3; 1; }
exportToExcel = Data.ExportToExcel(filePath=make_resultFilePath, sheetName=code_block_12, startRow=code_block_13.out0, startColumn=code_block_13.out1)  # unwired: data

watch = Watch(htmlPath)  # graph output
dashboardDataPart = Python()  # CPython3; unwired: IN[0]; starter script, not edited (OUT = 0)
allFamilyTypesPerCat_2 = Python()  # CPython3; unwired: IN[0]; same code as allFamilyTypesPerCat
parameters = Element.Parameters(element=allFamilyTypesPerCat_2)
code_block_14 = CodeBlock { "Type Name"; }
parameterByName = Parameter.ParameterByName(element=allFamilyTypesPerCat_2, name=code_block_14)
excel_data_2 = Python(IN[0]=lang_mode_영_한_select, IN[1]=importExcel, IN[2]=code_block_2)  # "Excel data dictionarizationScript"; CPython3
# ---------- excel_data_2.python (224 lines) ----------
# Load the Python Standard and DesignScript Libraries
import sys
import clr
clr.AddReference('ProtoGeometry')
from Autodesk.DesignScript.Geometry import *

from functools import reduce
from functools import partial

# The inputs to this node will be stored as a list in the IN variables.
dataEnteringNode = IN
lang_mode = IN[0]
wholeDatas = IN[1]
db = wholeDatas[1:]
allCatSheetsNames = IN[2][2:]

paramSheet = db[0]
allCatSheets = db[1:]

#db
# Place your code below this line
def make_UnifiedDict(dictsList):
    dicts_AllInOne = {}
    for d in dictsList:
        dict_k_v = d.items()
        for k,v in dict_k_v:
            dicts_AllInOne[k] = v
    return dicts_AllInOne

def find_IsInStr(target, str):
    if target == None or str == None:
        pass
    else:
        res = target in str
        return res
def find_range_by_columnItem(db, col_idx, sep_rule):
    tdb = list(map(lambda x: x[col_idx], db))
    last_idx_tdb = len(tdb)-1
    tdb_enum = enumerate(tdb)
    res = list(filter(lambda x: find_IsInStr(sep_rule, str(x[1])), tdb_enum))
    endidxs_tmp= list(map(lambda x: x[0]-1,res))
    endidxs_tmp.pop(0)
    endidxs = endidxs_tmp + [last_idx_tdb]
    famTypeNames = list(map(lambda x: x[1],res))
    famTypeNamesIdxs = list(map(lambda x: x[0],res))
    rangeSttIdxs = list(map(lambda x: x[0]+1,res))
    rangeEndIdxs = endidxs
    result = dict(zip(famTypeNames, zip(famTypeNamesIdxs, zip(rangeSttIdxs,rangeEndIdxs))))
    return result
    
    
def find_headersAtSheet(sheet):
    headers_sheet = map(lambda x: [x[1].replace("\n",""),x[0]], filter(lambda x: x[1] != None, enumerate(sheet[1])))
    
    return dict(headers_sheet)

def find_rangesAtSheet(sheet, hdrs_withIdx, trgt_hdr, trgt_str):
    return find_range_by_columnItem(sheet, hdrs_withIdx[trgt_hdr], trgt_str)


def get_DataOnRangesAtParamSheet(sheet):
    
    hdrs_withIdx = find_headersAtSheet(sheet)
    rangesATSheet = find_rangesAtSheet(sheet, hdrs_withIdx, "Q'ty Cal Type Tag", "-")
    title_idx = map(lambda x: x[0], rangesATSheet.values())
    calcType_colDatas = list(map(lambda x: x[hdrs_withIdx["Q'ty Cal Type Tag"]], sheet))
    calcTypes = list(map(lambda x: calcType_colDatas[x], title_idx))
    rgs_v = list(map(lambda x: x[1], rangesATSheet.values()))
    rgs_k = list(map(lambda x: x, rangesATSheet.keys()))
    
    hdrs_v = list(hdrs_withIdx.values())
    hdrs_k = list(hdrs_withIdx.keys())
    eff_hdrs_v = hdrs_v[2:]
    eff_hdrs_k = hdrs_k[2:]
    
    datas_allCalType = list(map(lambda x: sheet[x[0]-1:x[1]], rgs_v))
    
    def setDict_OnEachCalType(data_calType):
        paramName_lang = "패밀리 매개변수(from Revit) 영문판" if lang_mode is True else "패밀리 매개변수(from Revit) 한글판"
        calcTypeName = data_calType[0][2]
        data_calType_noneless = list(filter(lambda x: x[hdrs_withIdx["항목"]] != None, data_calType))
#        ## WM row 별 header명 과 짝짓기
        data_withHdrsIdx = list(map(lambda y: list(map(lambda x: y[x], eff_hdrs_v)), data_calType_noneless))
        dict_ = list(map(lambda x: dict(zip(eff_hdrs_k, x)), data_withHdrsIdx))
        dicts_noneless = list(map(lambda y: dict(filter(lambda x: x[1]!=None, y.items())),dict_))
#        ## dict_Cal Type 입력처리
        targetColName = "Q'ty Cal Type Tag"
        dicts_finalNoneless = []
        for d in dicts_noneless:
            d["Q'ty Cal Type Tag"] = calcTypeName
            
            if "입력값" in d.keys():
                d["applyForCalc"] = d["입력값"]
                dicts_finalNoneless.append(d)
            elif paramName_lang in d.keys():
                d["applyForCalc"] = d[paramName_lang]
                dicts_finalNoneless.append(d)
            else:
                pass
        
        return {calcTypeName: dicts_finalNoneless}
        
    return map(setDict_OnEachCalType, datas_allCalType)
    


def get_SymValDict_PerCalcType(dic):
    def findDictPerCalcType(dicList):
            dic = {}
            for i in dicList:
                dic[i["산출수식 약자"]] = i["applyForCalc"]
            return dic
    
    ks_forDic = list(dic.keys())
    vs_forDic = list(map(findDictPerCalcType, dic.values()))
    res = dict(zip(ks_forDic, vs_forDic))
    return res


def get_DataOnRangesAtCatSheet(catSheet):
    hdrs_withIdx = find_headersAtSheet(catSheet)
    rangesATSheet = find_rangesAtSheet(catSheet, hdrs_withIdx, "Family Type Name", "H_")
    title_idx = map(lambda x: x[0], rangesATSheet.values())
    calcType_colDatas = list(map(lambda x: x[hdrs_withIdx["Q'ty Cal Type Tag"]], catSheet))
    calcTypes = list(map(lambda x: calcType_colDatas[x], title_idx))
    rgs_v = list(map(lambda x: x[1], rangesATSheet.values()))
    rgs_k = list(map(lambda x: x, rangesATSheet.keys()))
    
    hdrs_v = list(hdrs_withIdx.values())
    hdrs_k = list(hdrs_withIdx.keys())
    
    datas_allFamType = list(map(lambda x: list(zip(catSheet[x[0]-1:x[1]], range(x[0]-1,x[1]))), rgs_v))
    
    def setDict_OnEachFamType(data_famType):  ## 최종적으로 산출식 없는 것 걸러내기 추가해야 함
        #eff_data_famType = filter(lambda x: x!=None, data_famType)
        
        titleData = list(data_famType)#.pop(0)#[0]
        
        #famTypeName = titleData[hdrs_withIdx["Family Type Name"]]
        #calcTypeName = titleData[hdrs_withIdx["Q'ty Cal Type Tag"]]
        #data_famType_noneless = list(filter(lambda x: x[0][5] != None, data_famType))
        ### WM row 별 header명 과 짝짓기
        #data_withHdrsIdx = list(map(lambda y: [list(map(lambda x: y[0][x], hdrs_v)), y[1]], data_famType_noneless))
        #hdrs_k.append("rIDX")
        #dict_ = list(map(lambda x: dict(zip(hdrs_k, x[0]+[x[1]])), data_withHdrsIdx))
        #dicts_noneless = list(map(lambda y: dict(filter(lambda x: x[1]!=None, y.items())),dict_))
        ### dict_gauge, 물량산출식 없는 항목 처리
        #dicts_final = []
        #needDefault_ColName = "Gauge Code"
        #noneRemove_ColName = "Dynamo 물량산출식"
        #for d in dicts_noneless:
        #    d["Family Type Name"] = famTypeName
        #    
        #    if calcTypeName == None:
        #        pass            
        #    elif noneRemove_ColName in d.keys():
        #        d["Q'ty Cal Type Tag"] = calcTypeName
        #        d[needDefault_ColName] = ""
        #        dicts_final.append(d)
        #
        #return dicts_final
        return titleData
        
    dicts_allFamType = list(map(lambda x: setDict_OnEachFamType(x), datas_allFamType))
    
    #aa = setDict_OnEachFamType(datas_allFamType[0])
    
    #ds_famTypesAtCatSheet = dict(zip(rgs_k, dicts_allFamType))
    #ds_famTypesAtCatSheet_effCalcType = dict(filter(lambda x: all(list(map(lambda i: "Q'ty Cal Type Tag" in i, x[1]))), list(ds_famTypesAtCatSheet.items())))
    #ds_famTypesAtCatSheet_noneless = dict(filter(lambda x: len(list(x[1]))!=0, list(ds_famTypesAtCatSheet_effCalcType.items())))
    #
    #return  ds_famTypesAtCatSheet_noneless
    return dicts_allFamType

def make_AIOdic(allCatSheets):

    dataOnRanges_allCat = list(map(get_DataOnRangesAtCatSheet, allCatSheets))
    dataOnRanges_allCat_WithCatNames = list(zip(allCatSheetsNames, dataOnRanges_allCat))
    
#    AIOdic = {}
#    for d in dataOnRanges_allCat_WithCatNames:
#        catName = d[0]
#        dict_k_v = d[1].items()
#        for k,v in dict_k_v:
#            for wm in v:
#                wm["SheetName"] = catName
#            AIOdic[k] = v
#    return AIOdic
    return get_DataOnRangesAtCatSheet(allCatSheets[0])



def matchWith_paramDic(catSheetDic, paramSheetDic):
    headers = list(catSheetDic.values())[0][0].keys()
    wmspec_headers = list(filter(lambda x: "Work C" in x or "Spec" in x, headers))
    res = {}
    for famType,diclist in catSheetDic.items():
        new_diclist = []
        for d in diclist:
            new_d = {}
            keys = d.keys()
            keys_new = set(keys) - set(wmspec_headers)
            calcType = d["Q'ty Cal Type Tag"]
            new_d["Sym_Val Dict"] = paramSheetDic[calcType]
            new_d["wmSpecs"] = list(map(lambda x: d[x],wmspec_headers))
            for spec in keys_new:
                new_d[spec] = d[spec]
            new_diclist.append(new_d)
        
        res[famType] = new_diclist
        
    return res

calcTypeDictsList = get_DataOnRangesAtParamSheet(paramSheet)
calcTypeDict = make_UnifiedDict(calcTypeDictsList)
paramSheetDic = get_SymValDict_PerCalcType(calcTypeDict) 

catSheetDic = make_AIOdic(allCatSheets)
#catFam_paramDic = matchWith_paramDic(catSheetDic, paramSheetDic)

# Assign your output to the OUT variable.

#OUT = [catFam_paramDic,paramSheetDic, catSheetDic]
OUT = catSheetDic
# ----------------------------------------
code_block_15 = CodeBlock(i=excel_data_2) { i[0]; }
code_block_16 = CodeBlock(i=code_block_15) { i[0]; }
code_block_17 = CodeBlock(i=code_block_16) { i[0]; }
