# Dynamo graph 입찰(3)_Room Schedule Automation_2.0.0.dyn "#3_Bid_Room Schedule_Automation(20240123)_rCs3" (Dynamo 2.16.1.2727)
# Fill up the Room Schedule Information into Building List

# group: 배치된 룸 객체 불러오기
rooms_by_status = RoomsByStatus()

# group: 룸 기준 레벨 불러오기
string = StringInput("Level")
parameterByName = Parameter.ParameterByName(element=rooms_by_status.PlacedRooms, name=string)
value = Parameter.Value(parameter=parameterByName)

# group: 룸 높이 설정
categories = Categories("OST_Levels")
all_elements_of_category = ElementsOfCategory(Category=categories)
elevation = Level.Elevation(level=all_elements_of_category)
round = Math.Round(number=elevation)
sort = List.Sort(list=round)
indexOf = List.IndexOf(list=round, element=sort)
getItemAtIndex = List.GetItemAtIndex(list=all_elements_of_category, index=indexOf)
count = List.Count(list=getItemAtIndex)
code_block = CodeBlock(n=count) { 0..n-2; 1..n-1; }
getItemAtIndex_2 = List.GetItemAtIndex(list=getItemAtIndex, index=code_block.out1)
elevation_2 = Level.Elevation(level=getItemAtIndex_2)
getItemAtIndex_3 = List.GetItemAtIndex(list=getItemAtIndex, index=code_block.out0)
elevation_3 = Level.Elevation(level=getItemAtIndex_3)
sub = elevation_2 - elevation_3
round_2 = Math.Round(number=sub)
flatten = List.Flatten(list=round_2)
name = Level.Name(level=getItemAtIndex)
indexOf_2 = List.IndexOf(list=name, element=value)
getItemAtIndex_4 = List.GetItemAtIndex(list=flatten, index=indexOf_2)
string_2 = StringInput("Limit Offset")
setParameterByName = Element.SetParameterByName(element=rooms_by_status.PlacedRooms, parameterName=string_2, value=getItemAtIndex_4)

# group: 룸 >> Bounding Box 생성 >> Width, Length, Height 추출하기
boundingBox = Element.BoundingBox(element=rooms_by_status.PlacedRooms)  # frozen
toPolySurface = BoundingBox.ToPolySurface(boundingBox=boundingBox)
surfaces = PolySurface.Surfaces(polySurface=toPolySurface)
code_block_2 = CodeBlock { 2..4..2; 3..5..2; }
getItemAtIndex_5 = List.GetItemAtIndex(list=surfaces, index=code_block_2.out0, lacing=CrossProduct)
firstItem = List.FirstItem(list=getItemAtIndex_5@L2)
lastItem = List.LastItem(list=getItemAtIndex_5@L2)
distanceTo = Geometry.DistanceTo(geometry=firstItem, other=lastItem)
number = DoubleInput(1)
round_3 = Math.Round(number=distanceTo, digits=number)
getItemAtIndex_6 = List.GetItemAtIndex(list=surfaces, index=code_block_2.out1, lacing=CrossProduct)
firstItem_2 = List.FirstItem(list=getItemAtIndex_6@L2)
lastItem_2 = List.LastItem(list=getItemAtIndex_6@L2)
distanceTo_2 = Geometry.DistanceTo(geometry=firstItem_2, other=lastItem_2)
number_2 = DoubleInput(1)
round_4 = Math.Round(number=distanceTo_2, digits=number_2)

# group: Width, Length, Height
watch_h_room_h_or_ch = Watch(getItemAtIndex_4)
watch_h_room_w = Watch(round_3)
watch_h_room_l = Watch(round_4)

code_block_3 = CodeBlock(rooms=rooms_by_status.PlacedRooms) { rooms; }

# group: check Rooms Width / Length
coreCenterBoundary = Room.CoreCenterBoundary(room=code_block_3)
byJoinedCurves = PolyCurve.ByJoinedCurves(curves=coreCenterBoundary)
flatten_2 = List.Flatten(list=byJoinedCurves)
byPatch = Surface.ByPatch(closedCurve=flatten_2)
code_block_4 = CodeBlock { 100; }
thicken = Surface.Thicken(surface=byPatch, thickness=code_block_4)
boundingBox_2 = Geometry.BoundingBox(geometry=thicken)
toCuboid = BoundingBox.ToCuboid(boundingBox=boundingBox_2)
width = Cuboid.Width(cuboid=toCuboid)
length = Cuboid.Length(cuboid=toCuboid)

# group: check Rooms Height
geometry = Element.Geometry(element=code_block_3)
flatten_3 = List.Flatten(list=geometry)
boundingBox_3 = Geometry.BoundingBox(geometry=flatten_3)
toCuboid_2 = BoundingBox.ToCuboid(boundingBox=boundingBox_3)
height = Cuboid.Height(cuboid=toCuboid_2)

room_size_정리 = Python(IN[0]=width, IN[1]=length, IN[2]=height)  # CPython3
# ---------- room_size_정리.python (19 lines) ----------
# Load the Python Standard and DesignScript Libraries
import sys
import clr
clr.AddReference('ProtoGeometry')
from Autodesk.DesignScript.Geometry import *

import math

# The inputs to this node will be stored as a list in the IN variables.
dataEnteringNode = IN
[ws, ls, hs] = [IN[0], IN[1], IN[2]]

# Place your code below this line

chk_size = lambda y: map(lambda x: math.floor(x/100)*100, y)
chk_height = lambda y: map(lambda x: math.floor(x/100)*100, y)
res = [chk_size(ws), chk_size(ls), chk_height(hs)]
# Assign your output to the OUT variable.
OUT = res#list(zip(*res))
# ----------------------------------------

# group: Building List File Path 입력
file_path = Filename("..\etc\_팀교육\3회차\플랜트건축팀_BIM_팀 표준_Building List_Rev0_2024.02.19_mk.xlsx")  # graph input

# group: Building List 불러오기 >> Room No. 데이터 추출
file_from_path = FileObject(path=file_path)
building_list_sheet_name = StringInput("Building List")  # graph input
boolean = BoolSelector(false)
importExcel = Data.ImportExcel(file=file_from_path, sheetName=building_list_sheet_name, readAsStrings=boolean)
number_3 = DoubleInput(4)
dropItems = List.DropItems(list=importExcel, amount=number_3)
number_4 = DoubleInput(8)
dropItems_2 = List.DropItems(list=dropItems@L2, amount=number_4)
transpose = List.Transpose(lists=dropItems_2)
firstItem_3 = List.FirstItem(list=transpose)

# group: Excel 팀 표준 데이터 불러오기
string_3 = StringInput("Int Finish Style No")
importExcel_2 = Data.ImportExcel(file=file_from_path, sheetName=string_3)  # frozen
transpose_2 = List.Transpose(lists=importExcel_2)
code_block_5 = CodeBlock(finish=transpose_2) { finish[2]; finish[3]; }

code_block_6 = CodeBlock { "Key Name"; }

# group: Room 사이즈 측정 : Width, Length, Height >> Excel 내보내기 위한 인덱스 및 데이터 정리
count_2 = List.Count(list=rooms_by_status.PlacedRooms)
code_block_7 = CodeBlock(list=importExcel) { list[3]; }
number_5 = DoubleInput(8)
dropItems_3 = List.DropItems(list=code_block_7, amount=number_5)
string_from_object = FromObject(object=dropItems_3)
string_4 = StringInput("room name")
boolean_2 = BoolSelector(true)
contains = String.Contains(string=string_from_object, searchFor=string_4, ignoreCase=boolean_2)
boolean_3 = BoolSelector(true)
indexOf_3 = List.IndexOf(list=contains, element=boolean_3)
ofRepeatedItem = List.OfRepeatedItem(item=indexOf_3, amount=count_2)
add = ofRepeatedItem + number_5

# group: 룸 번호 불러오기
string_5 = StringInput("Number")
parameterByName_2 = Parameter.ParameterByName(element=rooms_by_status.PlacedRooms, name=string_5)
value_2 = Parameter.Value(parameter=parameterByName_2)
python_script = Python(IN[0]=value_2)  # CPython3
# ---------- python_script.python (19 lines) ----------
# Python 표준 및 DesignScript 라이브러리 로드
import sys
import clr
clr.AddReference('ProtoGeometry')
from Autodesk.DesignScript.Geometry import *

# 이 노드에 대한 입력값은 IN 변수에 리스트로 저장됩니다.
dataEnteringNode = IN

# 코드를 이 선 아래에 배치

number = IN[0]
final = []

for i in range(len(number)):
    final.append(float(number[i]))

# 출력을 OUT 변수에 지정합니다.
OUT = final
# ----------------------------------------

# group: Excel - Building List - Room Number 데이터 및 인덱스 정리
isNull = Object.IsNull(object=firstItem_3)
boolean_4 = BoolSelector(false)
allIndicesOf = List.AllIndicesOf(list=isNull, item=boolean_4)
indexOf_4 = List.IndexOf(list=firstItem_3, element=python_script)
indexOf_5 = List.IndexOf(list=allIndicesOf, element=indexOf_4)
getItemAtIndex_7 = List.GetItemAtIndex(list=allIndicesOf, index=indexOf_5)
add_2 = getItemAtIndex_7 + number_3
# note: Excel - Room Number Index
watch = Watch(add_2)
getItemAtIndex_8 = List.GetItemAtIndex(list=firstItem_3, index=getItemAtIndex_7)
# note: Excel - Room Number
watch_2 = Watch(getItemAtIndex_8)

# group: 룸 기준 레벨 불러오기
string_6 = StringInput("Name")
parameterByName_3 = Parameter.ParameterByName(element=rooms_by_status.PlacedRooms, name=string_6)
value_3 = Parameter.Value(parameter=parameterByName_3)

# group: Room에 매개변수 입력
list_create = List.Create()  # unwired: item0, item1, item2
string_7 = StringInput("H_Room W")
string_8 = StringInput("H_Room L")
string_9 = StringInput("H_Room H or CH")
list_create_2 = List.Create(item0=string_7, item1=string_8, item2=string_9)
transpose_3 = List.Transpose(lists=room_size_정리)
count_3 = List.Count(list=transpose_3)
ofRepeatedItem_2 = List.OfRepeatedItem(item=list_create_2, amount=count_3)
setParameterByName_2 = Element.SetParameterByName(element=rooms_by_status.PlacedRooms, parameterName=ofRepeatedItem_2, value=transpose_3, lacing=Shortest)
join = List.Join()  # unwired: list0, list1
convert_by_units = DynamoUnitConvert(transpose_3, MeasurementType="autodesk.unit.quantity:length-1.0.4", FromConversion="autodesk.unit.unit:millimeters-1.0.1", ToConversion="autodesk.unit.unit:meters-1.0.0")
combine = List.Combine(combineFunction=join, list0=value_3, list1=convert_by_units)
number_6 = DoubleInput(4)
chop = List.Chop(list=combine@L2, lengths=number_6)

# group: Interior 정보 불러오기 >> Excel 내보내기 위한 데이터 및 인덱스 정리
string_10 = StringInput("Floor")
eq = string_from_object == string_10  # lacing=CrossProduct
boolean_5 = BoolSelector(true)
indexOf_6 = List.IndexOf(list=eq, element=boolean_5)
add_3 = indexOf_6 + number_5
ofRepeatedItem_3 = List.OfRepeatedItem(item=add_3, amount=count_2)

string_11 = StringInput("H_Floor Finish Style Name")
string_12 = StringInput("H_Skirt Finish Style Name")
string_13 = StringInput("H_Wall Finish Style Name")
string_14 = StringInput("H_Ceiling Finish Style Name")
join_2 = List.Join(list0=string_11, list1=string_12, list2=string_13, list3=string_14)
parameterByName_4 = Parameter.ParameterByName(element=rooms_by_status.PlacedRooms, name=join_2, lacing=CrossProduct)
value_4 = Parameter.Value(parameter=parameterByName_4)

# group: 마감 재료 >> 코드로 재료 불러오기 >> Excel Import 위한 데이터 정리
string_15 = StringInput("Floor Finish Style No")
string_16 = StringInput("Skirt Finish Style No")
string_17 = StringInput("Wall Finish Style No")
string_18 = StringInput("Ceiling Finish Style No")
join_3 = List.Join(list0=string_15, list1=string_16, list2=string_17, list3=string_18)
parameterByName_5 = Parameter.ParameterByName(element=rooms_by_status.PlacedRooms, name=join_3, lacing=CrossProduct)
value_5 = Parameter.Value(parameter=parameterByName_5)
join_4 = List.Join()  # unwired: list0, list1
flatten_4 = List.Flatten(list=value_4)
number_7 = DoubleInput(8)

getParameterValueByName = Element.GetParameterValueByName(element=value_5, parameterName=code_block_6)

# group (continued): 마감 재료 >> 코드로 재료 불러오기 >> Excel Import 위한 데이터 정리
indexOf_7 = List.IndexOf(list=code_block_5.out0, element=getParameterValueByName)
getItemAtIndex_9 = List.GetItemAtIndex(list=code_block_5.out1, index=indexOf_7)  # frozen
flatten_5 = List.Flatten(list=getParameterValueByName)
combine_2 = List.Combine(combineFunction=join_4, list0=flatten_5, list1=flatten_4)
count_4 = List.Count(list=getParameterValueByName@L2)
chop_2 = List.Chop(list=combine_2, lengths=count_4)
flatten_6 = List.Flatten(list=chop_2@L3)
chop_3 = List.Chop(list=flatten_6@L2, lengths=number_7)

# group: Excel 내보내기
ofRepeatedItem_4 = List.OfRepeatedItem(item=file_path, amount=count_2)
ofRepeatedItem_5 = List.OfRepeatedItem(item=building_list_sheet_name, amount=count_2)
exportToExcel = Data.ExportToExcel(filePath=ofRepeatedItem_4, sheetName=ofRepeatedItem_5, startRow=watch, startColumn=add, data=chop, lacing=Shortest)
exportToExcel_2 = Data.ExportToExcel(filePath=ofRepeatedItem_4, sheetName=ofRepeatedItem_5, startRow=watch, startColumn=ofRepeatedItem_3, data=chop_3)

code_block_8 = CodeBlock(i=code_block_5.out0) { i; }
parameters = Element.Parameters(element=value_5)
getitematindex_noneed = Python(IN[0]=code_block_5.out1, IN[1]=indexOf_7)  # CPython3; frozen
# ---------- getitematindex_noneed.python (24 lines) ----------
# Load the Python Standard and DesignScript Libraries
import sys
import clr
clr.AddReference('ProtoGeometry')
from Autodesk.DesignScript.Geometry import *

# The inputs to this node will be stored as a list in the IN variables.
dataEnteringNode = IN
src_list = IN[0]
idxs_list = IN[1]
# Place your code below this line

def getItem_withNonErrot(src_list,idxs):
    got_list = list(map(lambda x: src_list[x], idxs))
    res = []
    for i in got_list:
        if i == None:
            res.append("!!!This Type is Created By Project!!!")
        else:
            res.append(i)
    return res

# Assign your output to the OUT variable.
OUT = map(lambda x: getItem_withNonErrot(src_list,x), idxs_list)
# ----------------------------------------
