# Dynamo graph (개발중)거스 자동배치 전체건물_20250721.dyn (Dynamo 3.3.0.6316)

code_block = CodeBlock { 600; }
python_script = Python(IN[0]=code_block)  # CPython3
# ---------- python_script.python (133 lines) ----------
import clr
import math
from collections import defaultdict

clr.AddReference('RevitAPI')
clr.AddReference('RevitServices')
from Autodesk.Revit.DB import *
from RevitServices.Persistence import DocumentManager

doc = DocumentManager.Instance.CurrentDBDocument

# ──────────────────────────────────────────────────────────────
# ⚙️ 입력값 (허용 오차)
align_tol_mm = IN[0] if IN[0] else 300  # 그룹화 간격 기준
align_tol_ft = align_tol_mm / 304.8

grid_tol_mm = 1000  # Grid 교차점 근접 허용 범위
grid_tol_ft = grid_tol_mm / 304.8

# ──────────────────────────────────────────────────────────────
# 🔎 1. 그리드 교차점 추출
grids = FilteredElementCollector(doc).OfClass(Grid).ToElements()
ew_lines = []
ns_lines = []

for g in grids:
    curve = g.Curve
    dir = curve.Direction.Normalize()
    if abs(dir.X) > abs(dir.Y):  # 동서 방향
        ew_lines.append(curve)
    else:  # 남북 방향
        ns_lines.append(curve)

def line_line_intersection(l1, l2):
    """2D 선분 교차점 계산"""
    p1 = l1.GetEndPoint(0)
    p2 = l1.GetEndPoint(1)
    p3 = l2.GetEndPoint(0)
    p4 = l2.GetEndPoint(1)

    x1, y1 = p1.X, p1.Y
    x2, y2 = p2.X, p2.Y
    x3, y3 = p3.X, p3.Y
    x4, y4 = p4.X, p4.Y

    denom = (x1 - x2)*(y3 - y4) - (y1 - y2)*(x3 - x4)
    if abs(denom) < 1e-9:
        return None  # 평행 or 일치

    px = ((x1*y2 - y1*x2)*(x3 - x4) - (x1 - x2)*(x3*y4 - y3*x4)) / denom
    py = ((x1*y2 - y1*x2)*(y3 - y4) - (y1 - y2)*(x3*y4 - y3*x4)) / denom
    z = (p1.Z + p2.Z + p3.Z + p4.Z) / 4  # 평균 Z
    return XYZ(px, py, z)

grid_intersections = []
for l1 in ew_lines:
    for l2 in ns_lines:
        pt = line_line_intersection(l1, l2)
        if pt:
            grid_intersections.append(pt)

def is_near_grid_intersection(pt, intersections, tol):
    return any(pt.DistanceTo(gp) < tol for gp in intersections)

# ──────────────────────────────────────────────────────────────
# 🧱 2. 구조 기둥 필터링 (Grid 교차점 인근만)
columns = FilteredElementCollector(doc)\
    .OfCategory(BuiltInCategory.OST_StructuralColumns)\
    .WhereElementIsNotElementType().ToElements()

def get_column_point(col):
    loc = col.Location
    if hasattr(loc, "Curve"):
        return loc.Curve.GetEndPoint(0)
    elif hasattr(loc, "Point"):
        return loc.Point
    return None

main_col_pts = []
for col in columns:
    pt = get_column_point(col)
    if pt and is_near_grid_intersection(pt, grid_intersections, grid_tol_ft):
        main_col_pts.append((col, pt))

# ──────────────────────────────────────────────────────────────
# 📏 3. E-W / N-S 그룹화
ew_groups = defaultdict(list)
ns_groups = defaultdict(list)

for col, pt in main_col_pts:
    x, y = pt.X, pt.Y
    rounded_y = round(y / align_tol_ft)
    rounded_x = round(x / align_tol_ft)
    ew_groups[rounded_y].append((col, pt))
    ns_groups[rounded_x].append((col, pt))

# ──────────────────────────────────────────────────────────────
# 📐 4. Segment 생성
segments = []

def create_segment_from_group(pt_list, direction):
    if len(pt_list) < 2:
        return
    if direction == "E-W":
        pt_list.sort(key=lambda x: x[1].X)
    else:
        pt_list.sort(key=lambda x: x[1].Y)

    start = pt_list[0]
    end = pt_list[-1]
    length = start[1].DistanceTo(end[1])
    height = abs(start[1].Z - end[1].Z)
    if height == 0:
        height = 3000 / 304.8  # 기본 높이 설정

    segments.append({
        "segment_id": f"S{len(segments)+1:03}",
        "start_point": start[1],
        "end_point": end[1],
        "direction": direction,
        "length": length,
        "height": height,
        "col_pair": (start[0], end[0]),
        "group_count": len(pt_list)
    })

for group in ew_groups.values():
    create_segment_from_group(group, "E-W")
for group in ns_groups.values():
    create_segment_from_group(group, "N-S")

# ──────────────────────────────────────────────────────────────
OUT = segments
# ----------------------------------------
count = List.Count(list=python_script)
