# Dynamo graph (개발중)거스 자동배치_20250718.dyn (Dynamo 3.3.0.6316)

n1st_기준_기둥_선택 = DSModelElementSelection()  # "1st 기준 기둥 선택"; 1 picked in the model; graph input
n2nd_기준_기둥_선택 = DSModelElementSelection()  # "2nd 기준 기둥 선택"; 1 picked in the model; graph input
structural_framing_types = StructuralFramingTypes("H_SB_AR_B04_LC-200x75x25x4.0_Girth")  # graph input
퍼린_간격 = DoubleInput(1000)  # graph input
시작레벨 = DoubleInput(6000)  # graph input
끝레벨 = DoubleInput(14500)  # graph input
기둥으로부터_오프셋 = DoubleInput(800)  # graph input
custom_selection = CustomSelection("남", items={동: "e", 서: "w", 남: "s", 북: "n"}, IsVisibleDropDownTextBlock=true)  # graph input
단면회전 = CodeBlock { 180; }
그리드_연장_길이 = DoubleInput(600)  # graph input
python_script = Python(IN[0]=n1st_기준_기둥_선택, IN[1]=n2nd_기준_기둥_선택, IN[2]=structural_framing_types, IN[3]=퍼린_간격, IN[4]=시작레벨, IN[5]=끝레벨, IN[6]=기둥으로부터_오프셋, IN[7]=custom_selection, IN[8]=단면회전, IN[9]=그리드_연장_길이)  # CPython3
# ---------- python_script.python (103 lines) ----------
# IN[0] ~ IN[8] 동일
# IN[9] : girth 연장 길이 (mm, 양쪽 끝에 적용)

import clr
import math

clr.AddReference('RevitAPI')
clr.AddReference('RevitServices')
from Autodesk.Revit.DB import *
from RevitServices.Persistence import DocumentManager
from RevitServices.Transactions import TransactionManager

doc = DocumentManager.Instance.CurrentDBDocument

col1 = UnwrapElement(IN[0])
col2 = UnwrapElement(IN[1])
girth_type = UnwrapElement(IN[2])
spacing = IN[3] / 304.8
start_z = IN[4] / 304.8
end_z = IN[5] / 304.8
offset = IN[6] / 304.8
dir_str = IN[7]
rotation_deg = IN[8]
extension_mm = IN[9] if IN[9] else 0
extension_ft = extension_mm / 304.8

apply_rotation = isinstance(rotation_deg, (int, float))

def get_base_point(elem):
    loc = elem.Location
    if hasattr(loc, "Point"):
        return loc.Point
    elif hasattr(loc, "Curve"):
        return loc.Curve.GetEndPoint(0)
    else:
        return None

pt1 = get_base_point(col1)
pt2 = get_base_point(col2)

# 방향 벡터
line_vec = XYZ(pt2.X - pt1.X, pt2.Y - pt1.Y, pt2.Z - pt1.Z)
line_dir = line_vec.Normalize()

# offset 방향 처리
offset_dir = None
if isinstance(dir_str, str):
    dir_str = dir_str.strip().lower()
    if dir_str == "n":
        offset_dir = XYZ(0, 1, 0)
    elif dir_str == "s":
        offset_dir = XYZ(0, -1, 0)
    elif dir_str == "e":
        offset_dir = XYZ(1, 0, 0)
    elif dir_str == "w":
        offset_dir = XYZ(-1, 0, 0)

if not offset_dir:
    z_axis = XYZ.BasisZ
    offset_dir = z_axis.CrossProduct(line_dir).Normalize()

offset_vec = offset_dir.Multiply(offset)
extend_vec = line_dir.Multiply(extension_ft)

# Family 활성화
if not girth_type.IsActive:
    TransactionManager.Instance.EnsureInTransaction(doc)
    girth_type.Activate()
    doc.Regenerate()
    TransactionManager.Instance.TransactionTaskDone()

collector = FilteredElementCollector(doc).OfClass(Level)
base_level = collector.FirstElement()

z = start_z
girth_elems = []

TransactionManager.Instance.EnsureInTransaction(doc)

while z <= end_z:
    base1 = XYZ(pt1.X, pt1.Y, z).Add(offset_vec).Subtract(extend_vec)
    base2 = XYZ(pt2.X, pt2.Y, z).Add(offset_vec).Add(extend_vec)

    girth_line = Line.CreateBound(base1, base2)

    girth = doc.Create.NewFamilyInstance(
        girth_line,
        girth_type,
        base_level,
        Structure.StructuralType.Beam
    )

    if apply_rotation:
        param = girth.LookupParameter("Cross-Section Rotation")
        if param and not param.IsReadOnly:
            param.Set(math.radians(rotation_deg))

    girth_elems.append(girth)
    z += spacing

TransactionManager.Instance.TransactionTaskDone()

OUT = girth_elems
# ----------------------------------------
