# Dynamo graph (개발중)내벽높이자동조정_20250716.dyn "내벽높이자동조정_20250716" (Dynamo 3.3.0.6316)

룸_높이_일괄_수정 = Python()  # CPython3; unwired: IN[0]
# ---------- 룸_높이_일괄_수정.python (80 lines) ----------
# Dynamo Python Script for Batch Room Height Adjustment via Limit Offset
# IN: (없음)

import clr

# --- Revit API & Services ---
clr.AddReference('RevitAPI')
from Autodesk.Revit.DB import (
    FilteredElementCollector,
    BuiltInCategory,
    BuiltInParameter,
    UnitUtils,
    UnitTypeId,
    ElementId
)
clr.AddReference('RevitServices')
from RevitServices.Persistence import DocumentManager
from RevitServices.Transactions import TransactionManager

doc = DocumentManager.Instance.CurrentDBDocument

# 1) 모든 Room 수집
rooms = FilteredElementCollector(doc)\
    .OfCategory(BuiltInCategory.OST_Rooms)\
    .WhereElementIsNotElementType()\
    .ToElements()

modified_rooms = []
error_logs     = []

# 트랜잭션 시작 (한 번만)
TransactionManager.Instance.EnsureInTransaction(doc)

for room in rooms:
    # 2) "H_Room H or CH" 파라미터 읽기
    p = room.LookupParameter("H_Room H or CH")
    if p is None:
        continue

    # 3) 파라미터 값 취득 (내부 단위(ft) 또는 문자열)
    height_mm = None
    try:
        ft_val = p.AsDouble()
        if ft_val and ft_val != 0.0:
            # 내부 단위(ft) → mm
            height_mm = UnitUtils.ConvertFromInternalUnits(ft_val, UnitTypeId.Millimeters)
    except:
        s = p.AsString()
        if s:
            try:
                height_mm = float(s)
            except:
                pass

    # 값이 없거나 0이면 건너뜀
    if not height_mm:
        continue

    # 4) 원하는 총 높이를 유지하기 위해,
    #    Limit Offset = height_mm (mm) → 내부 단위(ft) 로 변환
    offset_param = room.get_Parameter(BuiltInParameter.ROOM_UPPER_OFFSET)
    if offset_param is None:
        error_logs.append(f"Room {room.Id.IntegerValue}: Limit Offset 파라미터 없음")
        continue

    # mm → 내부 단위(ft)
    offset_internal = UnitUtils.ConvertToInternalUnits(height_mm, UnitTypeId.Millimeters)

    # 5) Limit Offset 값 설정
    try:
        offset_param.Set(offset_internal)
        modified_rooms.append(room)
    except Exception as ex:
        error_logs.append(f"Room {room.Id.IntegerValue}: Limit Offset 설정 실패 – {ex}")

# 트랜잭션 완료
TransactionManager.Instance.TransactionTaskDone()

# OUT: 수정된 Room IDs, 에러 로그
OUT = modified_rooms, error_logs
# ----------------------------------------
geometry = Element.Geometry(element=룸_높이_일괄_수정)
벽높이_일괄_수정 = Python(IN[0]=룸_높이_일괄_수정)  # CPython3
# ---------- 벽높이_일괄_수정.python (112 lines) ----------
# Dynamo Python Script for Wall Top Constraint Adjustment Based on Room Heights
# IN: (없음)

import clr

dataEnteringNode = IN
success_list = IN[0]

# --- Revit API & Services ---
clr.AddReference('RevitAPI')
from Autodesk.Revit.DB import (
    FilteredElementCollector,
    BuiltInCategory,
    BuiltInParameter,
    SpatialElementBoundaryOptions,
    SpatialElementBoundaryLocation,
    UnitUtils,
    UnitTypeId,
    ElementId,
    Wall
)
clr.AddReference('RevitServices')
from RevitServices.Persistence import DocumentManager
from RevitServices.Transactions import TransactionManager

doc = DocumentManager.Instance.CurrentDBDocument

# 1) Build mapping: Wall.Id → list of adjacent room heights (mm)
opts = SpatialElementBoundaryOptions()
opts.SpatialElementBoundaryLocation = SpatialElementBoundaryLocation.Center

room_col = FilteredElementCollector(doc)\
    .OfCategory(BuiltInCategory.OST_Rooms)\
    .WhereElementIsNotElementType()\
    .ToElements()

wall_height_map = {}

for room in room_col:
    p = room.LookupParameter("H_Room H or CH")
    if p is None: continue

    # get height in mm
    height_mm = None
    try:
        ft = p.AsDouble()
        if ft and ft != 0.0:
            height_mm = UnitUtils.ConvertFromInternalUnits(ft, UnitTypeId.Millimeters)
    except:
        s = p.AsString()
        if s:
            try:
                height_mm = float(s)
            except:
                continue
    if height_mm is None:
        continue

    seg_lists = room.GetBoundarySegments(opts)
    if not seg_lists:
        continue

    for segList in seg_lists:
        for seg in segList:
            wid = seg.ElementId.IntegerValue
            wall_height_map.setdefault(wid, []).append(height_mm)

# 2) Filter walls and adjust top constraint
walls = FilteredElementCollector(doc)\
    .OfCategory(BuiltInCategory.OST_Walls)\
    .WhereElementIsNotElementType()\
    .ToElements()

modified = []
errors   = []

TransactionManager.Instance.EnsureInTransaction(doc)

for wall in walls:
    # 기존: wall_type = doc.GetElement(wall.GetTypeId()); if "_Int" not in wall_type.Name: continue
    # 수정:
    type_id   = wall.GetTypeId()
    wall_type = doc.GetElement(type_id)
    # .get_Name() 로 타입 이름을 읽어 옵니다
    type_name = wall_type.get_Name()
    if "_Int" not in type_name:
        continue

    wid     = wall.Id.IntegerValue
    heights = wall_height_map.get(wid)
    if not heights:
        continue

    target_mm       = max(heights) + 150.0
    target_internal = UnitUtils.ConvertToInternalUnits(target_mm, UnitTypeId.Millimeters)

    try:
        # Top Constraint → Unconnected
        param_top = wall.get_Parameter(BuiltInParameter.WALL_HEIGHT_TYPE)
        param_top.Set(ElementId.InvalidElementId)
        # Unconnected Height 설정
        param_unconn = wall.get_Parameter(BuiltInParameter.WALL_USER_HEIGHT_PARAM)
        if param_unconn:
            param_unconn.Set(target_internal)
            modified.append(wid)
    except Exception as ex:
        errors.append(f"Wall {wid}: {ex}")

TransactionManager.Instance.TransactionTaskDone()

# OUT: modified wall IDs, any errors
OUT = (modified, errors)
# ----------------------------------------
