# Dynamo graph (개발중)내벽높이자동조정_20250716_수정본_상부detach 적용.dyn "(개발중)내벽높이자동조정_20250716_수정본2" (Dynamo 3.3.0.6316)

룸_높이_일괄_수정 = Python()  # CPython3; unwired: IN[0]
# ---------- 룸_높이_일괄_수정.python (80 lines) ----------
# Dynamo Python Script for Batch Room Height Adjustment via Limit Offset
# IN: (없음)

import clr

# --- Revit API & Services ---
clr.AddReference('RevitAPI')
from Autodesk.Revit.DB import (
    FilteredElementCollector,
    BuiltInCategory,
    BuiltInParameter,
    UnitUtils,
    UnitTypeId,
    ElementId
)
clr.AddReference('RevitServices')
from RevitServices.Persistence import DocumentManager
from RevitServices.Transactions import TransactionManager

doc = DocumentManager.Instance.CurrentDBDocument

# 1) 모든 Room 수집
rooms = FilteredElementCollector(doc)\
    .OfCategory(BuiltInCategory.OST_Rooms)\
    .WhereElementIsNotElementType()\
    .ToElements()

modified_rooms = []
error_logs     = []

# 트랜잭션 시작 (한 번만)
TransactionManager.Instance.EnsureInTransaction(doc)

for room in rooms:
    # 2) "H_Room H or CH" 파라미터 읽기
    p = room.LookupParameter("H_Room H or CH")
    if p is None:
        continue

    # 3) 파라미터 값 취득 (내부 단위(ft) 또는 문자열)
    height_mm = None
    try:
        ft_val = p.AsDouble()
        if ft_val and ft_val != 0.0:
            # 내부 단위(ft) → mm
            height_mm = UnitUtils.ConvertFromInternalUnits(ft_val, UnitTypeId.Millimeters)
    except:
        s = p.AsString()
        if s:
            try:
                height_mm = float(s)
            except:
                pass

    # 값이 없거나 0이면 건너뜀
    if not height_mm:
        continue

    # 4) 원하는 총 높이를 유지하기 위해,
    #    Limit Offset = height_mm (mm) → 내부 단위(ft) 로 변환
    offset_param = room.get_Parameter(BuiltInParameter.ROOM_UPPER_OFFSET)
    if offset_param is None:
        error_logs.append(f"Room {room.Id.IntegerValue}: Limit Offset 파라미터 없음")
        continue

    # mm → 내부 단위(ft)
    offset_internal = UnitUtils.ConvertToInternalUnits(height_mm, UnitTypeId.Millimeters)

    # 5) Limit Offset 값 설정
    try:
        offset_param.Set(offset_internal)
        modified_rooms.append(room)
    except Exception as ex:
        error_logs.append(f"Room {room.Id.IntegerValue}: Limit Offset 설정 실패 – {ex}")

# 트랜잭션 완료
TransactionManager.Instance.TransactionTaskDone()

# OUT: 수정된 Room IDs, 에러 로그
OUT = modified_rooms, error_logs
# ----------------------------------------
geometry = Element.Geometry(element=룸_높이_일괄_수정)
벽_높이_일괄_수정 = Python(IN[0]=룸_높이_일괄_수정)  # CPython3
# ---------- 벽_높이_일괄_수정.python (139 lines) ----------
# Dynamo Python Script for Wall Top Constraint Adjustment Based on Room Heights
# IN: (없음)

import clr
import sys

# --- Revit API & Services ---
clr.AddReference('RevitAPI')
from Autodesk.Revit.DB import (
    FilteredElementCollector,
    BuiltInCategory,
    BuiltInParameter,
    SpatialElementBoundaryOptions,
    SpatialElementBoundaryLocation,
    UnitUtils,
    UnitTypeId,
    ElementId,
    Wall,
    AttachmentLocation,
)
clr.AddReference('RevitServices')
from RevitServices.Persistence import DocumentManager
from RevitServices.Transactions import TransactionManager

doc = DocumentManager.Instance.CurrentDBDocument

# 1) Build mapping: Wall.Id → {'heights': [...], 'has_missing': bool}
opts = SpatialElementBoundaryOptions()
opts.SpatialElementBoundaryLocation = SpatialElementBoundaryLocation.Center

room_col = FilteredElementCollector(doc) \
    .OfCategory(BuiltInCategory.OST_Rooms) \
    .WhereElementIsNotElementType() \
    .ToElements()

wall_info = {}  # wid → {'heights': [], 'has_missing': False}

for room in room_col:
    # 룸 식별
    room_id = room.LookupParameter("Number").AsString() + "_" + room.LookupParameter("Name").AsString()
    # H_Room H or CH 파라미터 읽기
    p = room.LookupParameter("H_Room H or CH")
    # 값 없거나 0 → missing
    missing = False
    height_mm = None

    if p is None:
        missing = True
    else:
        try:
            ft = p.AsDouble()
            if ft == 0.0:
                missing = True
            else:
                height_mm = UnitUtils.ConvertFromInternalUnits(ft, UnitTypeId.Millimeters)
        except:
            s = p.AsString()
            if not s:
                missing = True
            else:
                try:
                    height_mm = float(s)
                except:
                    missing = True

    # 룸 경계 세그먼트
    seg_lists = room.GetBoundarySegments(opts)
    if not seg_lists:
        continue

    # 각 세그먼트를 만든 벽체에 매핑
    for segList in seg_lists:
        for seg in segList:
            wid = seg.ElementId.IntegerValue
            info = wall_info.setdefault(wid, {'heights': [], 'has_missing': False})
            # missing 룸이 하나라도 있으면 플래그 세트
            if missing:
                info['has_missing'] = True
            else:
                info['heights'].append(height_mm)

# 2) Filter walls and adjust top constraint
walls = FilteredElementCollector(doc) \
    .OfCategory(BuiltInCategory.OST_Walls) \
    .WhereElementIsNotElementType() \
    .ToElements()

modified = []
errors   = []

TransactionManager.Instance.EnsureInTransaction(doc)

for wall in walls:
    # Wall 타입 이름 읽기
    type_id   = wall.GetTypeId()
    wall_type = doc.GetElement(type_id)
    type_name = wall_type.get_Name()
    # "_Int" 타입만 처리
    if "_Int" not in type_name:
        continue

    wid  = wall.Id.IntegerValue
    info = wall_info.get(wid)
    # 매핑 정보 없거나, missing 룸 플래그 세워졌으면 스킵
    if info is None or info['has_missing']:
        continue

    heights = info['heights']
    if not heights:
        continue


    # 최대 룸 높이에 150mm 추가
    target_mm       = max(heights) + 150.0
    target_internal = UnitUtils.ConvertToInternalUnits(target_mm, UnitTypeId.Millimeters)

    try:
        # 1) **Detach from host**: Top 위치에 붙은 모든 host 를 제거
        for targetId in wall.GetAttachmentIds(AttachmentLocation.Top):  # :contentReference[oaicite:0]{index=0}
            try:
                wall.RemoveAttachment(targetId, AttachmentLocation.Top)    # :contentReference[oaicite:1]{index=1}
            except:
                pass
                
        # Top Constraint → Unconnected
        param_top = wall.get_Parameter(BuiltInParameter.WALL_HEIGHT_TYPE)
        param_top.Set(ElementId.InvalidElementId)
        # Unconnected Height 설정
        param_unconn = wall.get_Parameter(BuiltInParameter.WALL_USER_HEIGHT_PARAM)
        if param_unconn:
            param_unconn.Set(target_internal)
            modified.append(wid)
    except Exception as ex:
        errors.append(f"Wall {wid}: {ex}")

TransactionManager.Instance.TransactionTaskDone()

# OUT: modified wall IDs, any errors
OUT = (modified, errors)
# ----------------------------------------
