# Dynamo graph [HSD kit]_하중분배 및 부재 해석_[1.1.5].dyn (Dynamo 2.16.1.2727)

# note: 소속 입면 정보도 딕셔너리 추가
# 외부기둥만(판별은 기둥 로케이션 라인 전체 바운딩 박스로)
# 내부기둥은 정보 없음으로
# Nside
# Eside
# Sside
# Wside

rooms_by_status = RoomsByStatus()
coreCenterBoundary = Room.CoreCenterBoundary(room=rooms_by_status.PlacedRooms)
byJoinedCurves = PolyCurve.ByJoinedCurves(curves=coreCenterBoundary)  # frozen
parameters = Element.Parameters(element=rooms_by_status.PlacedRooms)
code_block = CodeBlock()
# ---------- code_block.designscript (4 lines) ----------
// 1. case
// DL = 부재자중(메인부재 + 그레이팅 하중) + 유관부서 EL
// 2. case < -우선 구현
// DL = 각 층의 Floor 로드를 정해서 입력하는 방식
# ----------------------------------------
콘크리트_강도_선택_mpa = IntegerSlider(28, range=0..40 step 1)
framepart_미사용_js_에서_자동생성 = Python()  # CPython3; unwired: IN[0]
# ---------- framepart_미사용_js_에서_자동생성.python (19 lines) ----------
# Load the Python Standard and DesignScript Libraries
import sys
import clr
clr.AddReference('ProtoGeometry')
from Autodesk.DesignScript.Geometry import *

# The inputs to this node will be stored as a list in the IN variables.
dataEnteringNode = IN

# Place your code below this line
##folderPath_r = folderPath.replace('\\','\\\\')

htmlStr = f'''



'''
# Assign your output to the OUT variable.
OUT = htmlStr
# ----------------------------------------
materialPart = Python()  # CPython3; unwired: IN[0]
# ---------- materialPart.python (29 lines) ----------
# Load the Python Standard and DesignScript Libraries
import sys
import clr
clr.AddReference('ProtoGeometry')
from Autodesk.DesignScript.Geometry import *

# The inputs to this node will be stored as a list in the IN variables.
dataEnteringNode = IN

# Place your code below this line
##folderPath_r = folderPath.replace('\\','\\\\')

htmlStr = f'''

<div id="materialPage">

    <div class="container" id="material-Pane">
        <h2>[추가예정] 강종 선택기 & RC 강도 입력기</h2>


        <button>Save Data</button>
        <div id="mat-result"></div>
    </div>

</div>

'''
# Assign your output to the OUT variable.
OUT = htmlStr
# ----------------------------------------
loadPart = Python()  # CPython3; unwired: IN[0]
# ---------- loadPart.python (150 lines) ----------
# Load the Python Standard and DesignScript Libraries
import sys
import clr
clr.AddReference('ProtoGeometry')
from Autodesk.DesignScript.Geometry import *

# The inputs to this node will be stored as a list in the IN variables.
dataEnteringNode = IN

# Place your code below this line
##folderPath_r = folderPath.replace('\\','\\\\')

htmlStr = f'''
<div id="loadPage">
<div class="content">
    <div class="container">
        <h2>Dead Load Information 입력기</h2>
        <div class="form-group">
            <label for="DLinput">층별 DL 입력 (kN/m²)</label>
                <button id="increaseButton">+</button>
                <button id="decreaseButton">-</button>
                <div id="DLinputContainer"></div>
        </div>
        <button onclick="saveLoadData_asJson('HSD_DL.json', get_DL_json())">Save Data</button>
        <div id="DL-result"></div>
    </div>
    
    <div class="container">
        <h2>Live Load Information 입력기</h2>
        <div class="form-group">
            <label for="LLinput">층별 LL 입력 (kN/m²)</label>
                <button id="increaseButton">+</button>
                <button id="decreaseButton">-</button>
                <div id="LLinputContainer"></div>
        </div>
        <button onclick="saveLoadData_asJson('HSD_LL.json', get_LL_json())">Save Data</button>
        <div id="LL-result"></div>
    </div>
    
    <div class="container" id="wind-Pane">
        <h2>Wind Load Info. 입력기</h2>
        <div class="form-group-wind">
            <label for="wind-codeSelect">코드선택</label>
            <select class="wind_vals" id="wind-codeSelect" disabled>
                <option value="NA">None Application</option>
                <option value="ASCE" selected>ASCE 7-22</option>
                <option value="KDS">KDS 41 12 00</option>
                <option value="EN">EN1991-1-1-4</option>
            </select>
        </div>
        <div class="form-group-wind">
            <label for="BasicWindSpeed">Basic Wind Speed (m/s)</label>
            <input class="wind_vals" type="number" id="BasicWindSpeed" placeholder="Enter wind speed in m/s">
        </div>
        <div class="form-group-wind">
            <label for="exposureCategory">Exposure Category</label>
            <select class="wind_vals" id="exposureCategory">
                <option value="A">A</option>
                <option value="B">B</option>
                <option value="C">C</option>
                <option value="D">D</option>
            </select>
        </div>
        <div class="form-group-wind">
            <label for="TopoFactor">Topographic factor(Kzt)</label>
            <input class="wind_vals" type="number" id="TopoFactor" placeholder="Enter factor value">
        </div>
        <div class="form-group-wind">
            <label for="enclosureClass">Enclosure Classification</label>
            <select class="wind_vals" id="exposureCategory">
                <option value="A">Shelter</option>
                <option value="B">Building - Enclosed</option>
                <option value="C">Building - Parially Enclosed</option>
                <option value="D">Building - Open</option>
            </select>
        </div>

        <button onclick="saveLoadData_asJson('HSD_WL.json',get_WindInfo_json())">Save Data</button>
        <div id="wind-result"></div>
    </div>
    
    <div class="container">
        <h2>Seismic Load Info. 입력기</h2>
        <div class="form-group-seismic">
            <label for="codeSelect">코드선택</label>
            <select class="seismic_vals" id="codeSelect" disabled>
                <option value="NA">None Application</option>
                <option value="ASCE" selected>ASCE 7-05</option>
                <option value="KDS">KDS 41 12 00</option>
                <option value="EN">EN1991-8</option>
            </select>
        </div>
        <div class="form-group-seismic">
            <label for="siteClass">Site Class</label>
            <select class="seismic_vals" id="siteClass">
                <option value="A">A</option>
                <option value="B">B</option>
                <option value="C">C</option>
                <option value="D">D</option>
                <option value="E">E</option>
                <option value="F">F</option>
            </select>
        </div>
        <div class="form-group-seismic">
            <label for="riskCategory">Risk Category</label>
            <select class="seismic_vals" id="riskCategory">
                <option value="1">Ⅰ</option>
                <option value="2">Ⅱ</option>
                <option value="3">Ⅲ</option>
                <option value="4">Ⅳ</option>
            </select>
        </div>
        <div class="form-group">
            <label for="rmf">Response modification factor</label>
            <blockquote>
            <div class="form-group-seismic">
                <label for="rmfLong">Longitude Side (X-axis)</label>
                <input class="seismic_vals" type="number" id="rmfLong" placeholder="Enter factor value">
            </div>
            <div class="form-group-seismic">
                <label for="rmfTrans">Transverse Side (Y-axis)</label>
                <input class="seismic_vals" type="number" id="rmfTrans" placeholder="Enter factor value">
            </div>
            </blockquote>
        </div>
        <div class="form-group">
            <label for="spectralAccelParam">Spectral acceleration parameters</label>
            <blockquote>
            <div class="form-group-seismic">
                <label for="sapSds">Sds</label>
                <input class="seismic_vals" type="number" id="sapSds" placeholder="Enter factor value">
            </div>
            <div class="form-group-seismic">
                <label for="sapSd1">Sd1</label>
                <input class="seismic_vals" type="number" id="sapSd1" placeholder="Enter factor value">
            </div>
            </blockquote>
        </div>
        

        <button onclick="saveLoadData_asJson('HSD_SL.json',get_SeismicInfo_json())">Save Data</button>
        <div id="seismic-result"></div>
    </div>
</div>

</div>

'''
# Assign your output to the OUT variable.
OUT = htmlStr
# ----------------------------------------
n0_실행모드 = CustomSelection("입력모드", items={프레임스케치모드: "프레임스케치모드", 입력모드: "입력모드", 하중분배모드: "하중분배모드", 프레임해석모드: "프레임해석모드", 부재해석모드: "부재해석모드"})  # "0. 실행모드"; graph input
code_block_2 = CodeBlock(mode=n0_실행모드) { mode; }
code_block_3 = CodeBlock(mode=n0_실행모드) { mode; }

# group: Read Load Inform from Json
code_block_4 = CodeBlock { "\\.dynTemp\\"; }
folderPath = Python(IN[0]=code_block_4)  # CPython3
# ---------- folderPath.python (35 lines) ----------
# Load the Python Standard and DesignScript Libraries
import sys
import clr
clr.AddReference('ProtoGeometry')
from Autodesk.DesignScript.Geometry import *
import time
import subprocess
import os

clr.AddReference('RevitNodes')
import Revit
clr.ImportExtensions(Revit.Elements)
from Revit import Elements
# The inputs to this node will be stored as a list in the IN variables.
dataEnteringNode = IN
subPath = IN[0]
# Place your code below this line
def find_cwd():
    doc = Revit.Application.Document.Current
    filePath_string = doc.FilePath
    folderPath = filePath_string.split('\\')
    folderPath.pop(-1)
    folderPath_str = '\\'.join(folderPath)
    return folderPath_str

#cwd = find_cwd()
#cwd = os.getenv("HomePath")
#
#folderPath = f"{cwd}\\{dynTempServerPath}"
#if not os.path.exists(folderPath):
#    os.makedirs(folderPath)

# Assign your output to the OUT variable.
#OUT = map(lambda x: find_cwd() + x, subPaths) 
OUT = find_cwd() + subPath
# ----------------------------------------
download폴더_경로 = Python()  # CPython3; unwired: IN[0]
# ---------- download폴더_경로.python (15 lines) ----------
# Load the Python Standard and DesignScript Libraries
import sys
import clr
clr.AddReference('ProtoGeometry')
from Autodesk.DesignScript.Geometry import *
import os
# The inputs to this node will be stored as a list in the IN variables.
dataEnteringNode = IN

# Place your code below this line
def find_downloadPath():
    download = os.path.join(os.path.expanduser('~'), 'downloads')
    return download
# Assign your output to the OUT variable.
OUT = find_downloadPath()
# ----------------------------------------
directory_from_path = DirectoryObject(path=download폴더_경로)
getDirectoryContents = FileSystem.GetDirectoryContents(directory=directory_from_path)
code_block_5 = CodeBlock()
# ---------- code_block_5.designscript (6 lines) ----------
[
"HSD_DL",
"HSD_LL",
"HSD_WL",
"HSD_SL"
];
# ----------------------------------------
code_block_6 = CodeBlock { "\\jsons"; }
moveToTempFolder = Python(IN[0]=getDirectoryContents.files, IN[1]=code_block_5, IN[2]=folderPath, IN[3]=code_block_6, IN[4]=code_block_3)  # CPython3
# ---------- moveToTempFolder.python (138 lines) ----------
# Load the Python Standard and DesignScript Libraries
import sys
import clr
clr.AddReference('ProtoGeometry')
from Autodesk.DesignScript.Geometry import *
import re
import os
import shutil
################Module For Functional Programing#########################
from functools import reduce; from itertools import chain
from itertools import groupby; import operator
from copy import deepcopy
curry = lambda f: lambda a,*args: f(a, *args) if (len(args)) else lambda *args: f(a, *args)

filter, map, reduce = curry(filter), curry(map), curry(reduce)

go = lambda *args: reduce(lambda a,f: f(a), args) ## 함수도 축약 가능 ##

def dictUpdate(dic1,dic2):
    dic1.update(dic2)
    return dic1
    
def dictsMerge(dics):
    res = reduce(dictUpdate, dics)
    return res
    
def dictDeleteKeys(dic, keys):
    for k in keys:
        del dic[k]
    return dic

def flat(a):
    if isinstance(a, list):
        for i in a: 
            yield from flat(i)
    else: yield a

def grpBy(iter, key):
    f,keys,grps = key,[],[]
    sorted_ = sorted(iter, key=f)
    for key, grp_data in groupby(sorted_,key=f):
        keys.append(key); grps.append(list(grp_data))
    return grps,keys
#########################################################################
# The inputs to this node will be stored as a list in the IN variables.
dataEnteringNode = IN
fileNames = IN[0]
loadKinds = IN[1]
tmpPath = IN[2]
subPath = IN[3]
executionMode = IN[4]

# Place your code below this line
def find_downloadPath():
    download = os.path.join(os.path.expanduser('~'), 'downloads')
    return download
    
def find_allHSD_loads(fileNames, loadKind):
    allHSDs = go(
        fileNames,
        filter(lambda x: loadKind in x),
        list,
    )
    return allHSDs
    
def select_lastHSD(fileNames, loadKind):
    allHSDs = find_allHSD_loads(fileNames, loadKind)
    if len(allHSDs) == 1:
        res = allHSDs[0]
    elif len(allHSDs) > 2:
        res = go(
            allHSDs,
            filter(lambda x: '(' in x),
            sorted,
            lambda x: x[-1],
        )
    return res

def chk_allLastHSDs(fileNames, loadKinds):
    vals = []
    for x in loadKinds:
        try:
            vals.append(select_lastHSD(fileNames, x))
        except:
            vals.append(0)
            
    
    resDict = dict(zip(loadKinds, vals))
    
    return resDict

def read_allHSDsJson(loadDict):
    resDict = {}
    for k,v in loadDict.items():
        if v == 0:
            resDict[k] = "noData"
        else:
            with open(v, 'r', encoding='utf-8') as f:
                resDict[k] = f.read()
    return resDict
    
loadDict = chk_allLastHSDs(fileNames, loadKinds)


## copy allSrcFiles to .dynTemp

allSrcFilesFullPath = list(map(lambda x: find_allHSD_loads(fileNames, x), loadKinds))
allSrcFilesNameOnly = go(
    allSrcFilesFullPath,
    map(lambda grp: go(
        grp,
        map(lambda x: x.split('\\')),
        map(lambda x: x[-1]),
        map(lambda x: '\\'+ x),
        )
    ),
    lambda x: chain(*x),
    list,
)

def moveSrcToTemp(filename, tmpPath, subPath):
    tgtPath = tmpPath + subPath
    if not os.path.exists(tgtPath):
        os.makedirs(tgtPath)
    src = find_downloadPath()
    dir = tgtPath
    shutil.move(src + filename, dir + filename)
    return dir + filename

if executionMode == "하중분배모드":
    res = map(lambda x: moveSrcToTemp(x, tmpPath, subPath), allSrcFilesNameOnly)
elif executionMode != "하중분배모드":
    res = 0

# Assign your output to the OUT variable.
#OUT = allSrcFilesNameOnly

OUT = res
# ----------------------------------------
filter_the_last_hsd_파일 = Python(IN[0]=moveToTempFolder, IN[1]=code_block_5, IN[2]=folderPath, IN[3]=code_block_6)  # CPython3
# ---------- filter_the_last_hsd_파일.python (114 lines) ----------
# Load the Python Standard and DesignScript Libraries
import sys
import clr
clr.AddReference('ProtoGeometry')
from Autodesk.DesignScript.Geometry import *
import re
import os
import shutil
################Module For Functional Programing#########################
from functools import reduce; from itertools import chain
from itertools import groupby; import operator
from copy import deepcopy
curry = lambda f: lambda a,*args: f(a, *args) if (len(args)) else lambda *args: f(a, *args)

filter, map, reduce = curry(filter), curry(map), curry(reduce)

go = lambda *args: reduce(lambda a,f: f(a), args) ## 함수도 축약 가능 ##

def dictUpdate(dic1,dic2):
    dic1.update(dic2)
    return dic1
    
def dictsMerge(dics):
    res = reduce(dictUpdate, dics)
    return res
    
def dictDeleteKeys(dic, keys):
    for k in keys:
        del dic[k]
    return dic

def flat(a):
    if isinstance(a, list):
        for i in a: 
            yield from flat(i)
    else: yield a

def grpBy(iter, key):
    f,keys,grps = key,[],[]
    sorted_ = sorted(iter, key=f)
    for key, grp_data in groupby(sorted_,key=f):
        keys.append(key); grps.append(list(grp_data))
    return grps,keys
#########################################################################
# The inputs to this node will be stored as a list in the IN variables.
dataEnteringNode = IN
moveResult = IN[0]
loadKinds = IN[1]
tmpPath = IN[2]
subPath = IN[3]
tgtPath = tmpPath + subPath

# Place your code below this line
def find_downloadPath():
    download = os.path.join(os.path.expanduser('~'), 'downloads')
    return download

def get_allSrcFromTemp(tmpPath):
    fileNames = os.listdir(tmpPath)
    res = list(map(lambda x: tmpPath + '\\' + x, fileNames))
    return res

def find_allHSD_loads(fileNames, loadKind):
    allHSDs = go(
        fileNames,
        filter(lambda x: loadKind in x),
        list,
    )
    return allHSDs
    
def select_lastHSD(fileNames, loadKind):
    allHSDs = find_allHSD_loads(fileNames, loadKind)
    allCreatedTimes = list(map(lambda x: os.path.getctime(x), fileNames))
    if len(allHSDs) == 1:
        res = allHSDs[0]
    elif len(allHSDs) > 1:
        res = go(
            zip(allHSDs,allCreatedTimes),list,
            lambda x: sorted(x, key=lambda x: x[1]),
            lambda x: x[-1][0],
        )
    return res

def chk_allLastHSDs(fileNames, loadKinds):
    vals = []
    for x in loadKinds:
        try:
            vals.append(select_lastHSD(fileNames, x))
        except:
            vals.append(0)
            
    
    resDict = dict(zip(loadKinds, vals))
    
    return resDict

def read_allHSDsJson(loadDict):
    resDict = {}
    for k,v in loadDict.items():
        if v == 0:
            resDict[k] = "noData"
        else:
            with open(v, 'r', encoding='utf-8') as f:
                resDict[k] = f.read()
    return resDict
fileNames = get_allSrcFromTemp(tgtPath)

loadDict = chk_allLastHSDs(fileNames, loadKinds)


## delete all in downloads

# Assign your output to the OUT variable.
OUT = read_allHSDsJson(loadDict), loadDict
# ----------------------------------------

# group: HTML Export
javascriptPart = Python()  # CPython3; unwired: IN[0], IN[1], IN[2]
# ---------- javascriptPart.python (323 lines) ----------
# Load the Python Standard and DesignScript Libraries
import sys
import clr
clr.AddReference('ProtoGeometry')
from Autodesk.DesignScript.Geometry import *

# The inputs to this node will be stored as a list in the IN variables.
dataEnteringNode = IN


# Place your code below this line
jsPart = '''

function hideAllPages() {
  document.querySelector("#frame_MenuBtn").style.fontWeight = "normal";
  document.querySelector("#framePage").style.display = "None";
  document.querySelector("#material_MenuBtn").style.fontWeight = "normal";
  document.querySelector("#materialPage").style.display = "None";
  document.querySelector("#load_MenuBtn").style.fontWeight = "normal";
  document.querySelector("#loadPage").style.display = "None";

}


// 페이지가 로드되면 실행될 함수
window.addEventListener('load', init);


function init() {
  // canvas 엘리먼트 생성
  const canvas = document.createElement('canvas');
  canvas.setAttribute('id', 'framePage');
  console.log(canvas)

  // canvas 크기 설정
  canvas.width = window.innerWidth;
  canvas.height = window.innerHeight;

  // HTML 문서의 body 요소에 canvas 추가
  document.body.appendChild(canvas);
 
  // WebGLRenderer 생성 및 설정
  const renderer = new THREE.WebGLRenderer({ canvas });
  renderer.setSize(canvas.width, canvas.height);
  renderer.setClearColor(0xfdfdfd, 0.5);

  // 씬(Scene) 생성
  const scene = new THREE.Scene();

  // 카메라(Camera) 생성 (원근 투영 카메라)
  const camera = new THREE.PerspectiveCamera(30, window.innerWidth / window.innerHeight,1,500);
 
  // 카메라 위치 설정 (x, y, z 좌표)
  //camera.position.z =5;
  camera.position.set(50, 50, 100);
  camera.lookAt(0, 0, 0)
  
  // 오빗컨트롤 설정
  //new OrbitControls(camera, canvas);
  
  // 큐브(Geometry) 생성
  //const geometry = new THREE.BoxGeometry();
 
  // 재질(Material) 생성 (색상 지정)
  //const material = new THREE.MeshBasicMaterial({ color:"red" });
  const material = new THREE.LineBasicMaterial( { color: "black" } );
 
  // 메쉬(Mesh) 생성 (큐브와 재질을 결합)
  //const cube = new THREE.Mesh(geometry, material);
  
  // 선 생성
  const points = [];
  points.push( new THREE.Vector3( - 10, 0, 0 ) );
  points.push( new THREE.Vector3( 0, 10, 0 ) );
  points.push( new THREE.Vector3( 10, 0, 0 ) );
  
  const geometry = new THREE.BufferGeometry().setFromPoints( points );
  const line = new THREE.Line( geometry, material );
 
  // 씬에 메쉬 추가 
  //scene.add(cube);
  scene.add(line);
  renderer.render( scene, camera );

  
  function animate() {
    requestAnimationFrame(animate); 
    
    cube.rotation.x +=0.01;
    cube.rotation.y +=0.01;
   
    renderer.render(scene,camera); 
  }
  
  //animate(); 
}

function getCheckboxValue() {
    const query = 'input[name="isSlab"]'//:checked'
    const selectedEls = document.querySelectorAll(query);
    console.log(selectedEls[0]);
    
    //let result = '';
    let result = [];
    selectedEls.forEach((el) => {
        //result += el.value + ' ';
        if (el.checked) {
            result.push(el.value);
        } else {
            result.push('off');
        }
        
    });
    
    const resElem = document.getElementById('DL-result');
    resElem.setAttribute('data-result', result);
}

function setEventListener(target) {
    document.addEventListener('DOMContentLoaded', () => {
        const increaseButton = document.getElementById('increaseButton');
        const decreaseButton = document.getElementById('decreaseButton');
        const inputContainer = document.getElementById(target + 'inputContainer');
        console.log(target=='DL');
        console.log(target=='LL');
        let inputCount = 0;

        increaseButton.addEventListener('click', () => {
            inputCount++;
            const inputGroup = document.createElement('div');
            inputGroup.className = target + 'inputGroup';

            const label = document.createElement('label');
            label.textContent = inputCount + '.';

            const newInput = document.createElement('input');
            newInput.type = 'number';
            newInput.setAttribute('display', 'inline');
            newInput.placeholder = 'Enter load in kN/m²';
            
            const new_chkBoxLabel = document.createElement('label');
            const newInput_chkBox = document.createElement('input');
            
            if ( target == 'DL' ) {
                new_chkBoxLabel.textContent = "slab 여부 - "
                new_chkBoxLabel.setAttribute('display', 'inline');
                
                newInput_chkBox.type = 'checkbox';
                newInput_chkBox.setAttribute('name', 'isSlab');
                newInput_chkBox.setAttribute('onclick', 'getCheckboxValue()');
                newInput_chkBox.setAttribute('checked', 'checked');
                newInput_chkBox.setAttribute('display', 'inline');
            } else if ( target == 'LL' ) {
                new_chkBoxLabel.textContent = "slab 여부 - "
                new_chkBoxLabel.setAttribute('display', 'inline');
                new_chkBoxLabel.setAttribute('style', 'color:white');
                newInput_chkBox.type = 'checkbox';
                newInput_chkBox.setAttribute('name', 'noUse');
                newInput_chkBox.setAttribute('disabled', 'true');
            }
            
            
            inputGroup.appendChild(label);
            inputGroup.appendChild(newInput);
            inputGroup.appendChild(new_chkBoxLabel);
            inputGroup.appendChild(newInput_chkBox);
            inputContainer.appendChild(inputGroup);
        });

        decreaseButton.addEventListener('click', () => {
            if (inputContainer.lastChild) {
                inputContainer.removeChild(inputContainer.lastChild);
                inputCount--;
            }
        });
    });
}


function download(filename, text) {
    var element = document.createElement('a');
    element.setAttribute('href', 'data:text/plain;charset=utf-8,' + encodeURIComponent(text));
    const timeFilename = filename + Date.now().toString()
    element.setAttribute('download', timeFilename);
  
    element.style.display = 'none';
    document.body.appendChild(element);
  
    element.click();
  
    document.body.removeChild(element);
}

// download('test.txt', 'Hello world!');

function get_DL_json() {
    const inputs = document.querySelectorAll('.DLinputGroup input');
    let isSlab = document.getElementById('DL-result').getAttribute('data-result');
    console.log(isSlab);
    const res = inputs.values()
    const load_values = [];
    inputs.forEach((input, index) => {
        if (input.value != 'on') {
            load_values.push({ id: index + 1, value: input.value });
        }
        
    });
    if ( isSlab == null ) {
        isSlab = [];
        for (let i=0; i<load_values.length; i++){
            isSlab.push('on');
        };
    };
    console.log(load_values);
    
    const final = {
      "DL_info": load_values,
      "isSlab": isSlab
    };
    const jsonStr = JSON.stringify(final);
    return jsonStr;
}

function get_LL_json() {
    const inputs = document.querySelectorAll('.LLinputGroup input');
    const res = inputs.values()
    const values = [];
    inputs.forEach((input, index) => {
        if (input.value != 'on') {
            values.push({ id: index + 1, value: input.value });
        }
    });
    console.log(values);
    const jsonStr = JSON.stringify(values);
    return jsonStr;
}

function get_WindInfo_json() {
    const labels_ = document.querySelectorAll('.form-group-wind label');
    
    const labels = [];
    labels_.forEach((e) => {
        labels.push(e.innerHTML)
    });

    var vals_ = document.querySelectorAll('.wind_vals');
    const vals = [];
    vals_.forEach((e) => {
        vals.push(e.value)
    });

    const kvPairDict = {};
    for (let i = 0; i < labels.length; i++) {
        kvPairDict[labels[i]] = vals[i];
      };
    
    const resDict = {
        "wind_info": kvPairDict
    };
    const jsonStr = JSON.stringify(resDict);
    console.log(jsonStr);
    return jsonStr;
}

function get_SeismicInfo_json() {
    const labels_ = document.querySelectorAll('.form-group-seismic label');
    
    const labels = [];
    labels_.forEach((e) => {
        labels.push(e.innerHTML)
    });

    var vals_ = document.querySelectorAll('.seismic_vals');
    const vals = [];
    vals_.forEach((e) => {
        vals.push(e.value)
    });

    const kvPairDict = {};
    for (let i = 0; i < labels.length; i++) {
        kvPairDict[labels[i]] = vals[i];
      };
    
    const resDict = {
        "seismic_info": kvPairDict
    };
    const jsonStr = JSON.stringify(resDict);
    console.log(jsonStr);
    return jsonStr;
}

function saveLoadData_asJson(filename,jsonStr) {
    
    download(filename, jsonStr);
    alert("Save Completed!");

}

document.querySelector("#frame_MenuBtn").onclick = function() {
  hideAllPages();
  document.querySelector("#frame_MenuBtn").style.fontWeight = "bolder";
  document.querySelector("#framePage").style.display = "inline";
};

document.querySelector("#material_MenuBtn").onclick = function() {
  hideAllPages();
  document.querySelector("#material_MenuBtn").style.fontWeight = "bolder";
  document.querySelector("#materialPage").style.display = "inline";
};

document.querySelector("#load_MenuBtn").onclick = function() {
  hideAllPages();
  document.querySelector("#load_MenuBtn").style.fontWeight = "bolder";
  document.querySelector("#loadPage").style.display = "inline";
};


setEventListener('DL');
setEventListener('LL');
	
'''
# Assign your output to the OUT variable.
OUT = jsPart
# ----------------------------------------
cssPart = Python()  # CPython3; unwired: IN[0], IN[1], IN[2]
# ---------- cssPart.python (199 lines) ----------
# Load the Python Standard and DesignScript Libraries
import sys
import clr
clr.AddReference('ProtoGeometry')
from Autodesk.DesignScript.Geometry import *

# The inputs to this node will be stored as a list in the IN variables.
dataEnteringNode = IN

# Place your code below this line
cssPart = '''
/* style.css */
:root {
  --text-color: #f0f4f5;
  --background-color: #263343;
  --accent-color: orange;
  --icons-color: rgb(152, 187, 201);
  --bodybackground-color: lightgray;
}

canvas {
    display: block;
    }

body {
    font-family: Arial, sans-serif;
    /*display: flex;
    justify-content: center;
    align-items: center;*/
    height: 100vh;
    margin: 0;
    background-color: #f0f0f0;
}

.header {
    justify-content: center;
    align-items: center;
    text-align: center;
    margin: 20px 20px 20px 20px;
}

a {
  text-decoration: none;
  color: var(--text-color);
}

.navbar {
  display: flex;
  position: sticky;
  top: 0px; /* 도달했을때 고정시킬 위치 */
  justify-content: space-between;
  align-items: center;
  background-color: var(--background-color);
  padding: 8px 12px;
  font-family: 'STIX Two Math';
}

.navbar__logo i {
  color: var(--accent-color);
  padding-left: 0;
}

.navbar__menu {
  list-style: none;
  display: flex;
  margin: 0;
  padding-left: 0;
}

.navbar__menu li {
  padding: 8px 30px;
  color: var(--text-color);
}

.navbar__menu li:hover {
  background-color: var(--accent-color);
  border-radius: 3px;
}

.navbar__icons {
  list-style: none;
  display: flex;
  color: var(--icons-color);
  margin: 0;
  padding-left: 0;
}

.navbar__icons li {
  padding: 8px 12px;
  margin: 0;
}

.content {
    font-family: Arial, sans-serif;
    display: flex;
    justify-content: center;
    align-items: flex-start;
    height: 100vh;
    margin: 0;
    background-color: #f0f0f0;
}
.container {
    background: #fff;
    padding: 20px;
    margin: 20px 5px 5px 5px;
    border-radius: 8px;
    box-shadow: 0 0 10px rgba(0, 0, 0, 0.1);
    width: 350px;
    text-align: center;
    align-content: stretch;
    /*align-items: flex-start;*/
}

h1 {
    margin-bottom: 20px;
}

.form-group {
    margin-bottom: 15px;
    text-align: left;
}
.form-group-wind {
    margin-bottom: 15px;
    text-align: left;
}
.form-group-seismic {
    margin-bottom: 15px;
    text-align: left;
}

label {
    display: block;
    margin-bottom: 5px;
}

input, select {
    width: 100%;
    padding: 8px;
    box-sizing: border-box;
}

button {
    padding: 10px 20px;
    background: #007bff;
    border: none;
    color: #fff;
    border-radius: 4px;
    cursor: pointer;
}

button:hover {
    background: #0056b3;
}

#result {
    margin-top: 20px;
    font-size: 18px;
    font-weight: bold;
}

#increaseButton, #decreaseButton {
    font-size: 2rem;
    padding: 5px 5px;
    margin: 5px;
}

#inputContainer {
    display: flex;
    flex-direction: column;
    align-items: center;
}

.inputGroup {
    display: flex;
    align-items: center;
    margin: 5px 0;
}

.inputGroup label {
    margin-right: 10px;
    font-size: 1rem;
}


#framePage {
  display: inline;
}

#materialPage {
  display: None;
}

#loadPage {
  display: None;
}

'''
# Assign your output to the OUT variable.
OUT = cssPart
# ----------------------------------------
navHTML_Part = Python()  # CPython3; unwired: IN[0]
# ---------- navHTML_Part.python (26 lines) ----------
# Load the Python Standard and DesignScript Libraries
import sys
import clr
clr.AddReference('ProtoGeometry')
from Autodesk.DesignScript.Geometry import *

# The inputs to this node will be stored as a list in the IN variables.
dataEnteringNode = IN

# Place your code below this line
navPart = f'''

<nav class="navbar">

  <ul class="navbar__menu">
    <li id="frame_MenuBtn">Frame View</li>
    <li id="material_MenuBtn">About Material</li>
    <li id="load_MenuBtn">About Load Info.</li>
  </ul>

</nav>

'''

# Assign your output to the OUT variable.
OUT = navPart
# ----------------------------------------
list_create = List.Create(item0=framepart_미사용_js_에서_자동생성, item1=materialPart, item2=loadPart)
make_htmlStr = Python(IN[0]=javascriptPart, IN[1]=cssPart, IN[2]=navHTML_Part, IN[4]=list_create)  # CPython3; unwired: IN[3]
# ---------- make_htmlStr.python (53 lines) ----------
# Load the Python Standard and DesignScript Libraries
import sys
import clr
clr.AddReference('ProtoGeometry')
from Autodesk.DesignScript.Geometry import *

# The inputs to this node will be stored as a list in the IN variables.
dataEnteringNode = IN
jsPart = IN[0]
cssPart = IN[1]
nav_part = IN[2]

contents = IN[4]
material_part = contents[1]
load_part = contents[2]

# Place your code below this line
##folderPath_r = folderPath.replace('\\','\\\\')

htmlStr = f'''
<!DOCTYPE html>
<html lang="en">
<head>
    <meta charset="UTF-8">
    <meta name="viewport" content="width=device-width, initial-scale=1.0">
    <title>HSD tool-kit Input Window</title>
</head>
<style>
{cssPart}
</style>

<body>

<div class="header">
<h1>::: HSD tool-kit Input Center :::</h1>
</div>

{nav_part}

{material_part}

{load_part}
    
    <script src="https://cdnjs.cloudflare.com/ajax/libs/three.js/r128/three.min.js"></script>
    <script src="https://cdnjs.cloudflare.com/ajax/libs/three.js/r134/examples/js/controls/OrbitControls.js"></script>
    <script src="js/script.js"></script>
    
</body>
</html>

'''
# Assign your output to the OUT variable.
OUT = htmlStr
# ----------------------------------------
code_block_7 = CodeBlock(htmlStr=make_htmlStr) { htmlStr; }
code_block_8 = CodeBlock(htmlPath=folderPath) { htmlPath; }
set_port_number_기본값_8500_작동_오류 = StringInput("8500")  # "Set Port Number: 기본값-8500 (작동 오류 없다면 변경 금지)"; graph input
code_block_9 = CodeBlock(mode=code_block_2) { mode; }
create_html_file_and_open = Python(IN[0]=code_block_7, IN[1]=code_block_8, IN[2]=set_port_number_기본값_8500_작동_오류, IN[3]=code_block_9)  # CPython3
# ---------- create_html_file_and_open.python (91 lines) ----------
# Load the Python Standard and DesignScript Libraries
import os
import sys
import clr
clr.AddReference('ProtoGeometry')
from Autodesk.DesignScript.Geometry import *

clr.AddReference('RevitNodes')
import Revit
clr.ImportExtensions(Revit.Elements)
from Revit import Elements

import time
import subprocess
import asyncio
import multiprocessing

#################################Module For Functional Programing#############################################
from functools import reduce
curry = lambda f: lambda a,*args: f(a, *args) if (len(args)) else lambda *args: f(a, *args)

filter = curry(filter)
map = curry(map)

def _take(length, iter):
    res = []
    for a in iter:
        res.append(a)
        if len(res) == length:
            return res
        
take = curry(_take)
reduce = curry(reduce)

go = lambda *args: reduce(lambda a,f: f(a), args) ## 함수도 축약 가능 ##
##############################################################################################################

# The inputs to this node will be stored as a list in the IN variables.
dataEnteringNode = IN
contents = IN[0]
folderPath = IN[1]
cwd = folderPath
portNo = IN[2]
executionMode = IN[3]
# Place your code below this line

def find_cwd():
    doc = Revit.Application.Document.Current
    filePath_string = doc.FilePath
    folderPath = filePath_string.split('\\')
    folderPath.pop(-1)
    folderPath_str = '\\'.join(folderPath)
    return folderPath_str

def make_resultHTMLname(htmlStr,title,cwd):
    #timeStamp = time.strftime('%H_%M_%S', time.localtime(time.time()))
    #folderPath = f"{cwd}\\.dynLog"
    folderPath = cwd
    if not os.path.exists(folderPath):
        os.makedirs(folderPath)
    fileName = f"index.html"
    filePath = f"{folderPath}\\" + fileName
    f = open(filePath, 'w', encoding='utf8')
    f.write(htmlStr)
    f.close()
    return fileName


def execute_browser(cwd):
    #cwd = find_cwd()
    folderPath = cwd
    os.chdir(folderPath)
    #cmdStr = "start chrome http:localhost:8000"
    cmdStr = f"start msedge http:localhost:{portNo}"
    cmdList= cmdStr.split(' ')
    #subprocess.run(args=[fileName], shell=True)
    #subprocess.run(args=['start','excel',fileName], shell=True)
    subprocess.run(args=cmdList, shell=True)
    return cmdList


fileName = make_resultHTMLname(contents,"test",cwd)

if executionMode != "입력모드":
    res = 0
elif executionMode == "입력모드":
    res = execute_browser(cwd)


# Assign your output to the OUT variable.
OUT = res, fileName
# ----------------------------------------
create_js_file = Python(IN[0]=javascriptPart, IN[1]=code_block_8, IN[2]=code_block_9)  # CPython3
# ---------- create_js_file.python (86 lines) ----------
# Load the Python Standard and DesignScript Libraries
import os
import sys
import clr
clr.AddReference('ProtoGeometry')
from Autodesk.DesignScript.Geometry import *

clr.AddReference('RevitNodes')
import Revit
clr.ImportExtensions(Revit.Elements)
from Revit import Elements

import time
import subprocess

#################################Module For Functional Programing#############################################
from functools import reduce
curry = lambda f: lambda a,*args: f(a, *args) if (len(args)) else lambda *args: f(a, *args)

filter = curry(filter)
map = curry(map)

def _take(length, iter):
    res = []
    for a in iter:
        res.append(a)
        if len(res) == length:
            return res
        
take = curry(_take)
reduce = curry(reduce)

go = lambda *args: reduce(lambda a,f: f(a), args) ## 함수도 축약 가능 ##
##############################################################################################################

# The inputs to this node will be stored as a list in the IN variables.
dataEnteringNode = IN
contents = IN[0]
folderPath = IN[1]
executionMode = IN[2]
# Place your code below this line
def find_cwd():
    doc = Revit.Application.Document.Current
    filePath_string = doc.FilePath
    folderPath = filePath_string.split('\\')
    folderPath.pop(-1)
    folderPath_str = '\\'.join(folderPath)
    return folderPath_str

#cwd = find_cwd()
cwd = folderPath

def make_resultHTMLname(jsStr,cwd):
    #timeStamp = time.strftime('%H_%M_%S', time.localtime(time.time()))
    #folderPath = f"{cwd}\\.dynLog"
    folderPath = cwd
    jsPath = cwd + "\\js"
    if not os.path.exists(folderPath):
        os.makedirs(folderPath)
    if not os.path.exists(jsPath):
        os.makedirs(jsPath)
    fileName = "script.js"
    filePath = f"{jsPath}\\" + fileName
    f = open(filePath, 'w', encoding='utf8')
    f.write(jsStr)
    f.close()
    return fileName

def execute_file(fileName):
    #cwd = find_cwd()
    folderPath = cwd
    os.chdir(folderPath)
    subprocess.run(args=[fileName], shell=True)
    #subprocess.run(args=['start','excel',fileName], shell=True)
    

#fileName = make_resultHTMLname(contents,cwd)


if executionMode != "입력모드":
    res = 0
elif executionMode == "입력모드":
    res = make_resultHTMLname(contents,cwd)

# Assign your output to the OUT variable.
OUT = res
# ----------------------------------------
make_htmlStr_2 = Python(IN[0]=javascriptPart, IN[1]=cssPart)  # CPython3; frozen; unwired: IN[2]
# ---------- make_htmlStr_2.python (53 lines) ----------
# Load the Python Standard and DesignScript Libraries
import sys
import clr
clr.AddReference('ProtoGeometry')
from Autodesk.DesignScript.Geometry import *

# The inputs to this node will be stored as a list in the IN variables.
dataEnteringNode = IN
jsPart = IN[0]
cssPart = IN[1]
tablePart = IN[2]

# Place your code below this line
##folderPath_r = folderPath.replace('\\','\\\\')

htmlStr = f'''
<!DOCTYPE html>
<html lang="ko">

<head>
    <meta charset="UTF-8">
    <title>my first three.js app</title>
    <style>
        {cssPart}
    </style>
</head>

<body>


<div class="wrapper">

  <a data-fslightbox="gallery" href="#custom-source">
    유튜브 라이트박스
  </a>

  <iframe id="custom-source"
          frameborder="0"
          width="1920px"
          height="1080px"
          allow="autoplay; fullscreen"
          src="https://www.youtube.com/embed/qgBSiRwsbNw?autoplay=1">
  </iframe>
</div>

<script src="https://cdnjs.cloudflare.com/ajax/libs/fslightbox/3.3.1/index.min.js" integrity="sha512-EqNNJuepkw5P9vxCml8eBk7C4Ld+4kAnvzOD/jG21rkxWPILGoQa5EvD62UieiJF0u3xoQrcVnce4i83VnYj/Q==" crossorigin="anonymous" referrerpolicy="no-referrer"></script>

</body>

</html>
'''
# Assign your output to the OUT variable.
OUT = htmlStr
# ----------------------------------------
start_webserver = Python(IN[0]=code_block_8, IN[1]=set_port_number_기본값_8500_작동_오류, IN[2]=code_block_9)  # CPython3
# ---------- start_webserver.python (54 lines) ----------
# Load the Python Standard and DesignScript Libraries
import sys
import clr
clr.AddReference('ProtoGeometry')
from Autodesk.DesignScript.Geometry import *

import os
import asyncio
import multiprocessing
import subprocess
# The inputs to this node will be stored as a list in the IN variables.
dataEnteringNode = IN
cwd = IN[0]
portNo = IN[1]
executionMode = IN[2]
# Place your code below this line
batStr = f"""
@echo on
python -m http.server {portNo}
cmd /k
"""
##cmd /k
title = "localWebserver"

def make_startSever_bat(batStr,title,cwd):
    folderPath = cwd
    if not os.path.exists(folderPath):
        os.makedirs(folderPath)
    fileName = f"{title}.bat"
    filePath = f"{folderPath}\\" + fileName
    f = open(filePath, 'w', encoding='utf8')
    f.write(batStr)
    f.close()
    return fileName

def startBat(fileName, cwd):
    cmdStr = f".\\{fileName}"
    cmdList= cmdStr.split(' ')
    os.chdir(cwd)
    
    res = subprocess.Popen(args=cmdList, shell=True)
    return res

batFileName = make_startSever_bat(batStr,title,cwd)

if executionMode != "입력모드":
    res = 0
elif executionMode == "입력모드":
    res = startBat(batFileName, cwd)

# Assign your output to the OUT variable.
OUT = res

#startBat(fileName, cwd)
# ----------------------------------------

latest_hsd = CodeBlock(i=filter_the_last_hsd_파일) { i[0]; }
값_있는_항목만_필터링 = Python(IN[0]=latest_hsd)  # CPython3
# ---------- 값_있는_항목만_필터링.python (58 lines) ----------
# Load the Python Standard and DesignScript Libraries
import sys
import clr
clr.AddReference('ProtoGeometry')
from Autodesk.DesignScript.Geometry import *
import json
import os
################Module For Functional Programing#########################
from functools import reduce; from itertools import chain
from itertools import groupby; import operator
from copy import deepcopy
curry = lambda f: lambda a,*args: f(a, *args) if (len(args)) else lambda *args: f(a, *args)

filter, map, reduce = curry(filter), curry(map), curry(reduce)

go = lambda *args: reduce(lambda a,f: f(a), args) ## 함수도 축약 가능 ##

def dictUpdate(dic1,dic2):
    dic1.update(dic2)
    return dic1
    
def dictsMerge(dics):
    res = reduce(dictUpdate, dics)
    return res
    
def dictDeleteKeys(dic, keys):
    for k in keys:
        del dic[k]
    return dic

def flat(a):
    if isinstance(a, list):
        for i in a: 
            yield from flat(i)
    else: yield a

def grpBy(iter, key):
    f,keys,grps = key,[],[]
    sorted_ = sorted(iter, key=f)
    for key, grp_data in groupby(sorted_,key=f):
        keys.append(key); grps.append(list(grp_data))
    return grps,keys
#########################################################################
# The inputs to this node will be stored as a list in the IN variables.
dataEnteringNode = IN
loadDict = IN[0]
# Place your code below this line
    
def del_noDataKey_inDict(loadDict):
    resDict = {}
    for k,v in loadDict.items():
        if v == "noData":
            pass
        else:
            resDict[k] = json.loads(v)
    return resDict
# Assign your output to the OUT variable.
OUT = del_noDataKey_inDict(loadDict)
# ----------------------------------------
code_block_10 = CodeBlock(i=값_있는_항목만_필터링) { i["HSD_WL"]["wind_info"]; }
code_block_11 = CodeBlock(i=값_있는_항목만_필터링) { i["HSD_SL"]["seismic_info"]; }
concave_hull = Python()  # CPython3; unwired: IN[0]
# ---------- concave_hull.python (55 lines) ----------
# Load the Python Standard and DesignScript Libraries
import sys
import clr
clr.AddReference('ProtoGeometry')
from Autodesk.DesignScript.Geometry import *
from math import sqrt, hypot
from itertools import combinations
# The inputs to this node will be stored as a list in the IN variables.
dataEnteringNode = IN

# Place your code below this line
def concave_hull_(points, alpha):
    points = UnwrapElement(points)
    res = []
    
    pLen = len(points)
    alpha2 = alpha * alpha
    if pLen < 2:
        raise Exception('AlphaShape needs at least 2 points')

    for i, p in enumerate(points):
        for j in range(i+1, pLen):
            if p.IsAlmostEqualTo(points[j]):
                raise Exception('AlphaShape needs pairwise distinct points')
            dist = hypot(p.X - points[j].X, p.Y - points[j].Y)                    
            #if (dist > 2 * alpha) : continue #circle fits between points ==> p_i, p_j can't be alpha-exposed                    
    
            x1, y1, x2, y2 = p.X, p.Y, points[j].X, points[j].Y
            midX, midY = (x1 + x2) / 2, (y1 + y2) / 2
    
            #find two circles that contain p_i and p_j; note that center1 == center2 if dist == 2*alpha
            alphaDist = sqrt(alpha2 - (dist / 2) ** 2)
            #alphaDist = alpha2 - (dist / 2) ** 2
            deltaX, deltaY = (x2 - x1) / dist, (y1 - y2) / dist
            c1x, c1y = midX + alphaDist * deltaY, midY + alphaDist * deltaX
            c2x, c2y = midX - alphaDist * deltaY, midY - alphaDist * deltaX
            
            #check if one of the circles is alpha-exposed, i.e. no other point lies in it
            c1_empty = True 
            c2_empty = True
            for k in range(pLen):                
                if i == k or j == k: 
                    continue
                if ((c1x - points[k].X) * (c1x - points[k].X) + (c1y - points[k].Y) * (c1y - points[k].Y) < alpha2):
                    c1_empty = False
                if ((c2x - points[k].X) * (c2x - points[k].X) + (c2y - points[k].Y) * (c2y - points[k].Y) < alpha2):
                    c2_empty = False
                if not c1_empty and not c2_empty:
                    break
            if c1_empty or c2_empty:
                res.append(Line.ByStartPointEndPoint(p, points[j]))
                #res.append(c1_empty)
    return res
# Assign your output to the OUT variable.
OUT = concave_hull_
# ----------------------------------------
categories = Categories("OST_StructuralFraming")
all_elements_of_category = ElementsOfCategory(Category=categories)
code_block_12 = CodeBlock(allBeams=all_elements_of_category) { allBeams; }
getLevelsDict = Python(IN[0]=all_elements_of_category)  # CPython3
# ---------- getLevelsDict.python (89 lines) ----------
# Load the Python Standard and DesignScript Libraries
import sys
import clr
clr.AddReference('ProtoGeometry')
from Autodesk.DesignScript.Geometry import *

################Module For Functional Programing#########################
from functools import reduce; from itertools import chain
from itertools import groupby; import operator
from copy import deepcopy
curry = lambda f: lambda a,*args: f(a, *args) if (len(args)) else lambda *args: f(a, *args)

filter, map, reduce = curry(filter), curry(map), curry(reduce)

go = lambda *args: reduce(lambda a,f: f(a), args) ## 함수도 축약 가능 ##

def dictUpdate(dic1,dic2):
    dic1.update(dic2)
    return dic1
    
def dictsMerge(dics):
    res = reduce(dictUpdate, dics)
    return res
    
def dictDeleteKeys(dic, keys):
    for k in keys:
        del dic[k]
    return dic

def flat(a):
    if isinstance(a, list):
        for i in a: 
            yield from flat(i)
    else: yield a

def grpBy(iter, key):
    f,keys,grps = key,[],[]
    sorted_ = sorted(iter, key=f)
    for key, grp_data in groupby(sorted_,key=f):
        keys.append(key); grps.append(list(grp_data))
    return grps,keys
#########################################################################
# The inputs to this node will be stored as a list in the IN variables.
dataEnteringNode = IN
allFrames = IN[0]
# Place your code below this line

def getAllFrameLvs(allFrames):
    allFrames_loc = list(map(lambda x: x.GetLocation(),allFrames))
    allFrameLvElevations = go(
        allFrames_loc,
        map(lambda x: x.StartPoint.Z),set,
        sorted,
    )
    return allFrameLvElevations

def getAllLvs(allFrames):
    allLvElevations = getAllFrameLvs(allFrames)
    if 0 in allLvElevations:
        res = allLvElevations
    elif 0 not in allLvElevations:
        res = [0] + allLvElevations
    
    return res

def index_toName(datas):
    rngsStr = list(map(str, range(len(datas))))
    allNames = go(
        rngsStr,
        map(lambda x: "0" + x if len(x) < 2 else x)
    )
    return allNames

def getLevelsDict(allFrames):
    allFrames_loc = list(map(lambda x: x.GetLocation(), allFrames))
    allLvElevations = getAllLvs(allFrames)
    
    lvNames = index_toName(allLvElevations)
    
    resDict = go(
        zip(lvNames, allLvElevations),
        dict,
    )
    
    return resDict

res = getLevelsDict(allFrames)
# Assign your output to the OUT variable.
OUT = res
# ----------------------------------------
categories_2 = Categories("OST_StructuralColumns")
all_elements_of_category_2 = ElementsOfCategory(Category=categories_2)
allCols = CodeBlock(allCols=all_elements_of_category_2) { allCols; }
find_longitudinalaxis_건물의_장축방향 = Python(IN[0]=allCols)  # "find_longitudinalAxis(건물의 장축방향 벡터)"; CPython3
# ---------- find_longitudinalaxis_건물의_장축방향.python (85 lines) ----------
# Load the Python Standard and DesignScript Libraries
import sys
import clr
clr.AddReference('ProtoGeometry')
from Autodesk.DesignScript.Geometry import *

################Module For Functional Programing#########################
from functools import reduce; from itertools import chain
from itertools import groupby; import operator
from copy import deepcopy
curry = lambda f: lambda a,*args: f(a, *args) if (len(args)) else lambda *args: f(a, *args)

filter, map, reduce = curry(filter), curry(map), curry(reduce)

go = lambda *args: reduce(lambda a,f: f(a), args) ## 함수도 축약 가능 ##

def dictUpdate(dic1,dic2):
    dic1.update(dic2)
    return dic1
    
def dictsMerge(dics):
    res = reduce(dictUpdate, dics)
    return res
    
def dictDeleteKeys(dic, keys):
    for k in keys:
        del dic[k]
    return dic

def flat(a):
    if isinstance(a, list):
        for i in a: 
            yield from flat(i)
    else: yield a

def grpBy(iter, key):
    f,keys,grps = key,[],[]
    sorted_ = sorted(iter, key=f)
    for key, grp_data in groupby(sorted_,key=f):
        keys.append(key); grps.append(list(grp_data))
    return grps,keys
#########################################################################
# The inputs to this node will be stored as a list in the IN variables.
dataEnteringNode = IN
allCols = IN[0]
# Place your code below this line
def index_toName(datas):
    rngsStr = list(map(str, range(len(datas))))
    allNames = go(
        rngsStr,
        map(lambda x: "0" + x if len(x) < 2 else x)
    )
    return allNames
    
def get_BuilingBdBox(allCols):
    allCols_loc = list(map(lambda x: x.GetLocation(),allCols))
    bdBox = BoundingBox.ByGeometry(allCols_loc).ToCuboid()
    return bdBox

def find_longitudinalAxis(allCols):
    bdBox = get_BuilingBdBox(allCols)
    btmFace_PeriLine = go(
        bdBox,
        lambda x: x.Explode(),
        filter(lambda x: x.NormalAtParameter(0.5,0.5).Z == -1),
        list, lambda x: x[0],
        lambda x: x.PerimeterCurves(),
    )
    longitudinalVec = go(
        btmFace_PeriLine,
        map(lambda x: x.Length), max,
        lambda x: filter(lambda y: y.Length == x, btmFace_PeriLine),
        list,lambda x:x[0],
        lambda x: x.Direction.Normalized(),
    )
    if longitudinalVec.X < 0 or longitudinalVec.Y < 0:
        longitudinalVec = longitudinalVec.Reverse()
    else:
        pass
    
    return longitudinalVec

res = find_longitudinalAxis(allCols)
# Assign your output to the OUT variable.
OUT = res
# ----------------------------------------
get_framenodict_장축방향 = Python(IN[0]=allCols, IN[1]=find_longitudinalaxis_건물의_장축방향)  # CPython3
# ---------- get_framenodict_장축방향.python (83 lines) ----------
# Load the Python Standard and DesignScript Libraries
import sys
import clr
clr.AddReference('ProtoGeometry')
from Autodesk.DesignScript.Geometry import *

################Module For Functional Programing#########################
from functools import reduce; from itertools import chain
from itertools import groupby; import operator
from copy import deepcopy
curry = lambda f: lambda a,*args: f(a, *args) if (len(args)) else lambda *args: f(a, *args)

filter, map, reduce = curry(filter), curry(map), curry(reduce)

go = lambda *args: reduce(lambda a,f: f(a), args) ## 함수도 축약 가능 ##

def dictUpdate(dic1,dic2):
    dic1.update(dic2)
    return dic1
    
def dictsMerge(dics):
    res = reduce(dictUpdate, dics)
    return res
    
def dictDeleteKeys(dic, keys):
    for k in keys:
        del dic[k]
    return dic

def flat(a):
    if isinstance(a, list):
        for i in a: 
            yield from flat(i)
    else: yield a

def grpBy(iter, key):
    f,keys,grps = key,[],[]
    sorted_ = sorted(iter, key=f)
    for key, grp_data in groupby(sorted_,key=f):
        keys.append(key); grps.append(list(grp_data))
    return grps,keys
#########################################################################
# The inputs to this node will be stored as a list in the IN variables.
dataEnteringNode = IN
allCols = IN[0]
bdLongiVec = IN[1]
# Place your code below this line
def index_toName(datas):
    rngsStr = list(map(str, range(len(datas))))
    allNames = go(
        rngsStr,
        map(lambda x: "0" + x if len(x) < 2 else x)
    )
    return allNames
    
def get_SpansDict(allCols, bdLongiVec):
    xSpans = go(
        allCols,
        lambda x: grpBy(x, lambda x: x.GetLocation().StartPoint.X)[1],
        sorted,list
    )
    ySpans = go(
        allCols,
        lambda x: grpBy(x, lambda x: x.GetLocation().StartPoint.Y)[1],
        sorted,list
    )
    
    if bdLongiVec.IsParallel(Vector.XAxis()):
        spans = xSpans
    elif bdLongiVec.IsParallel(Vector.YAxis()):
        spans = ySpans
    
    spanNames = index_toName(spans)
    resDict = go(
        zip(spanNames, spans),
        dict,
    )
    return resDict


res = get_SpansDict(allCols, bdLongiVec), get_SpansDict(allCols, bdLongiVec.Rotate(Vector.ZAxis(), 90) )
# Assign your output to the OUT variable.
OUT = res
# ----------------------------------------
longAxis = CodeBlock(i=get_framenodict_장축방향) { i[0]; }
shortAxis = CodeBlock(i=get_framenodict_장축방향) { i[1]; }
allCols_2 = CodeBlock(allCols=allCols) { allCols; }
항복강도 = CodeBlock { 2.65000e-01*1000; }
탄성계수 = CodeBlock { 2.00000e+02*1000; }
포아송_수 = CodeBlock { 0.3; }
materialPropDict = CodeBlock(Fy=항복강도, E=탄성계수, u=포아송_수)
# ---------- materialPropDict.designscript (6 lines) ----------
{
"Fy": Fy,
"E": E,
"u": u,
"G": E/(2*(1+u))
};
# ----------------------------------------
toDict_allBeams = Python(IN[0]=code_block_12, IN[1]=getLevelsDict, IN[2]=longAxis, IN[3]=shortAxis, IN[4]=allCols_2, IN[5]=materialPropDict)  # CPython3
# ---------- toDict_allBeams.python (322 lines) ----------
# Load the Python Standard and DesignScript Libraries
import sys
import clr
clr.AddReference('ProtoGeometry')
from Autodesk.DesignScript.Geometry import *

################Module For Functional Programing#########################
from functools import reduce; from itertools import chain
from itertools import groupby; import operator
from copy import deepcopy
curry = lambda f: lambda a,*args: f(a, *args) if (len(args)) else lambda *args: f(a, *args)

filter, map, reduce = curry(filter), curry(map), curry(reduce)

go = lambda *args: reduce(lambda a,f: f(a), args) ## 함수도 축약 가능 ##

def dictUpdate(dic1,dic2):
    dic1.update(dic2)
    return dic1
    
def dictsMerge(dics):
    res = reduce(dictUpdate, dics)
    return res
    
def dictDeleteKeys(dic, keys):
    for k in keys:
        del dic[k]
    return dic

def flat(a):
    if isinstance(a, list):
        for i in a: 
            yield from flat(i)
    else: yield a

def grpBy(iter, key):
    f,keys,grps = key,[],[]
    sorted_ = sorted(iter, key=f)
    for key, grp_data in groupby(sorted_,key=f):
        keys.append(key); grps.append(list(grp_data))
    return grps,keys
#########################################################################
# The inputs to this node will be stored as a list in the IN variables.
dataEnteringNode = IN
allLvsDict = IN[1]
allBeams = IN[0]
frameNoDict = IN[2]
shortAxisNoDict = IN[3]
allCols = IN[4]
materialPropDict = IN[5]
# Place your code below this line
def chck_intsctWithCols(frame, allColsGeo):
    frameLocation = frame\
                    .GetLocation()\
                    .ExtendStart(500)\
                    .ExtendEnd(500)
    res = frameLocation.DoesIntersect(allColsGeo)
    
    return res

def filter_allGirders(allBeamsDicts, allCols):
    allColsGeo = go(
        allCols,
        map(lambda x: x.Geometry()[0]),list,
        Solid.ByUnion,
    )
    girders = go(
        allBeamsDicts,list,
        filter(lambda x: chck_intsctWithCols(x, allColsGeo)),
        list,
    )
    beams = go(
        allBeamsDicts,list,
        filter(lambda x: not chck_intsctWithCols(x, allColsGeo)),
        list,
    )
    
    return girders, beams



def toDict_allGirders(allGirders, frameNoDict, allLvsDict, shortAxisNoDict, materialPropDict):
    
    def find_Ix(elem):
        _tw = elem.GetParameterValueByName("Family and Type")\
            .GetParameterValueByName("Web Thickness") * 10
        _tf = elem.GetParameterValueByName("Family and Type")\
            .GetParameterValueByName("Flange Thickness") * 10
        _h = elem.GetParameterValueByName("Family and Type")\
            .GetParameterValueByName("Height") * 10
        _bf = elem.GetParameterValueByName("Family and Type")\
            .GetParameterValueByName("Width") * 10
        
        Ix = (2*(_bf*_tf**3/12+_bf*_tf*((_h-2*_tf)/2+_tf/2)**2)+_tw*(_h-2*_tf)**3/12)
        Ix_revit = elem.GetParameterValueByName("Family and Type")\
            .GetParameterValueByName("Moment of Inertia strong axis") * 10**4
        return Ix_revit
    
    def find_numberNameByElem(elem, nameDict, axis):
        tgtDict = {
            "X": elem.GetLocation().StartPoint.X,
            "Y": elem.GetLocation().StartPoint.Y,
            "Z": min(
                [
                elem.GetLocation().StartPoint.Z,
                elem.GetLocation().EndPoint.Z
                ]),
                
        }
        res = []
        tgt = tgtDict[axis]
        for k,v in list(nameDict.items()):
            if v == tgt:
                res.append(k)
        return res

    def find_numberNameByPt(pt, nameDict, axis):
        tgtDict = {
            "X": pt.X,
            "Y": pt.Y,
            "Z": pt.Z,
        }
        res = []
        tgt = tgtDict[axis]
        for k,v in list(nameDict.items()):
            if v == tgt:
                res.append(k)
        return res

    def find_nodeName(elem, frameNoDict, shortAxisNoDict, allLvsDict):
        sttPt = elem.GetLocation().StartPoint
        
        endPt = elem.GetLocation().EndPoint
        
        name_stt_X = find_numberNameByPt(sttPt, frameNoDict, "X")[0]
        name_stt_Y = find_numberNameByPt(sttPt, shortAxisNoDict, "Y")[0]
        name_stt_Z = find_numberNameByPt(sttPt, allLvsDict, "Z")[0]
        name_stt = "1" + name_stt_X + name_stt_Y + name_stt_Z
        
        sttNodeDict = dict([("name",name_stt), ("Y",sttPt.Y), ("Z",sttPt.Z)])
        
        name_end_X = find_numberNameByPt(endPt, frameNoDict, "X")[0]
        name_end_Y = find_numberNameByPt(endPt, shortAxisNoDict, "Y")[0]
        name_end_Z = find_numberNameByPt(endPt, allLvsDict, "Z")[0]
        name_end = "1" + name_end_X + name_end_Y + name_end_Z
        
        endNodeDict = dict([("name",name_end), ("Y",endPt.Y), ("Z",endPt.Z)])
        
        return sttNodeDict, endNodeDict
        
    def find_elemDirection(line):
        lineVector = line.Direction.Normalized()
        if abs(lineVector.X) > 0:
            res = "longAxis"
        elif abs(lineVector.Y) > 0:
            res = "shortAxis"
        return res

    def convertElementName(elem, replaceIDX, replaceChar):
        element_name = list(find_nodeName(elem, frameNoDict, shortAxisNoDict, allLvsDict)[0]["name"])
        element_name[replaceIDX] = replaceChar
        element_name_modified = "".join(element_name)
        return element_name_modified

    resDict = go(
        allGirders,
        map( lambda x: {
            "elem": x,
            "element_name": convertElementName(x, 0, "3"),
            "sectionProp":{
                "name": x.GetParameterValueByName("Type").GetParameterValueByName("Type Name"),
                "sectionRotating": x.GetParameterValueByName("Cross-Section Rotation"),
                "A": x.GetParameterValueByName("Family and Type")\
                .GetParameterValueByName("Section Area") * 10**2,
                "I": find_Ix(x),
            },
            "GUID": x.GetParameterValueByName("IfcGUID"),
            "role": "Girders",
            "location_line": x.GetLocation(),
            # 노드 추가
            "startNode": find_nodeName(x, frameNoDict, shortAxisNoDict, allLvsDict)[0],
            "endNode": find_nodeName(x, frameNoDict, shortAxisNoDict, allLvsDict)[1],
            "planeDirection": find_elemDirection(x.GetLocation()),
            "length": x.GetLocation().Length,
            "asgned_srfs": [],
            "asgned_area": 0,
            "frameNo": find_numberNameByElem(x, frameNoDict, "X")[0],
            "lvBelong": find_numberNameByElem(x, allLvsDict, "Z")[0],
            "sideBelong": [] ,
            "materialPropDict": materialPropDict,
        } )
    )
    return resDict

def toDict_allBeams(allBeams, frameNoDict, allLvsDict, shortAxisNoDict, input_E):
    
    def find_Ix(elem):
        _tw = elem.GetParameterValueByName("Family and Type")\
            .GetParameterValueByName("Web Thickness") * 10
        _tf = elem.GetParameterValueByName("Family and Type")\
            .GetParameterValueByName("Flange Thickness") * 10
        _h = elem.GetParameterValueByName("Family and Type")\
            .GetParameterValueByName("Height") * 10
        _bf = elem.GetParameterValueByName("Family and Type")\
            .GetParameterValueByName("Width") * 10
        
        Ix = (2*(_bf*_tf**3/12+_bf*_tf*((_h-2*_tf)/2+_tf/2)**2)+_tw*(_h-2*_tf)**3/12)
        Ix_revit = elem.GetParameterValueByName("Family and Type")\
            .GetParameterValueByName("Moment of Inertia strong axis") * 10**4
        return Ix_revit
    
    def find_numberNameByElem(elem, nameDict, axis):
        tgtDict = {
            "X": elem.GetLocation().StartPoint.X,
            "Y": elem.GetLocation().StartPoint.Y,
            "Z": min(
                [
                elem.GetLocation().StartPoint.Z,
                elem.GetLocation().EndPoint.Z
                ]),
                
        }
        res = []
        tgt = tgtDict[axis]
        for k,v in list(nameDict.items()):
            if v == tgt:
                res.append(k)
        return res

    def find_numberNameByPt(pt, nameDict, axis):
        tgtDict = {
            "X": pt.X,
            "Y": pt.Y,
            "Z": pt.Z,
        }
        res = []
        tgt = tgtDict[axis]
        for k,v in list(nameDict.items()):
            if v == tgt:
                res.append(k)
        return res

    def find_nodeName(elem, frameNoDict, shortAxisNoDict, allLvsDict):
        sttPt = elem.GetLocation().StartPoint
        
        endPt = elem.GetLocation().EndPoint
        
        #name_stt_X = find_numberNameByPt(sttPt, frameNoDict, "X")[0]
        #name_stt_Y = find_numberNameByPt(sttPt, shortAxisNoDict, "Y")[0]
        #name_stt_Z = find_numberNameByPt(sttPt, allLvsDict, "Z")[0]
        name_stt = "tbd"#"1" + name_stt_X + name_stt_Y + name_stt_Z
        
        sttNodeDict = dict([("name",name_stt), ("Y",sttPt.Y), ("Z",sttPt.Z)])
        
        #name_end_X = find_numberNameByPt(endPt, frameNoDict, "X")[0]
        #name_end_Y = find_numberNameByPt(endPt, shortAxisNoDict, "Y")[0]
        #name_end_Z = find_numberNameByPt(endPt, allLvsDict, "Z")[0]
        name_end = "tbd"#"1" + name_end_X + name_end_Y + name_end_Z
        
        endNodeDict = dict([("name",name_end), ("Y",endPt.Y), ("Z",endPt.Z)])
        
        return sttNodeDict, endNodeDict
        
    def find_elemDirection(line):
        lineVector = line.Direction.Normalized()
        if abs(lineVector.X) > 0:
            res = "longAxis"
        elif abs(lineVector.Y) > 0:
            res = "shortAxis"
        return res

    def convertElementName(elem, replaceIDX, replaceChar):
        element_name = list(find_nodeName(elem, frameNoDict, shortAxisNoDict, allLvsDict)[0]["name"])
        element_name[replaceIDX] = replaceChar
        element_name_modified = "".join(element_name)
        return element_name_modified

    resDict = go(
        allBeams,
        map( lambda x: {
            "elem": x,
            "element_name": convertElementName(x, 0, "3"),
            "sectionProp":{
                "name": x.GetParameterValueByName("Type").GetParameterValueByName("Type Name"),
                "sectionRotating": x.GetParameterValueByName("Cross-Section Rotation"),
                "A": x.GetParameterValueByName("Family and Type")\
                .GetParameterValueByName("Section Area") * 10**2,
                "I": find_Ix(x),
            },
            "GUID": x.GetParameterValueByName("IfcGUID"),
            "role": "Beams",
            "location_line": x.GetLocation(),
            # 노드 추가
            "startNode": find_nodeName(x, frameNoDict, shortAxisNoDict, allLvsDict)[0],
            "endNode": find_nodeName(x, frameNoDict, shortAxisNoDict, allLvsDict)[1],
            "planeDirection": find_elemDirection(x.GetLocation()),
            "length": x.GetLocation().Length,
            "asgned_srfs": [],
            "asgned_area": 0,
            "frameNo": "tbd",#find_numberNameByElem(x, frameNoDict, "X")[0],
            "lvBelong": find_numberNameByElem(x, allLvsDict, "Z")[0],
            "sideBelong": [] ,
            "materialPropDict": materialPropDict,
        } )
    )
    return resDict

#allBeamsDicts = toDict_allBeams(allBeams, frameNoDict, allLvsDict)
allGirders = filter_allGirders(allBeams, allCols)[0]
allBeams = filter_allGirders(allBeams, allCols)[1]

allGirdersDicts = toDict_allGirders(allGirders, frameNoDict, allLvsDict, shortAxisNoDict, materialPropDict)

allBeamsDicts = toDict_allBeams(allBeams, frameNoDict, allLvsDict, shortAxisNoDict, materialPropDict)

#allBeamsDicts = toDict_allGirders(allBeams, frameNoDict, allLvsDict, shortAxisNoDict, input_E)
#allGirdersDicts_X = list(filter(lambda x: x["planeDirection"]=="shortAxis", allGirdersDicts))

res = allGirdersDicts, allBeamsDicts

# Assign your output to the OUT variable.
OUT = res
# ----------------------------------------
all_beams = CodeBlock(i=toDict_allBeams) { i[1]; }
allGirdersDicts = CodeBlock(i=toDict_allBeams) { i[0]; }
code_block_13 = CodeBlock(LevelsDict=getLevelsDict) { LevelsDict; }

# group: DL input
code_block_14 = CodeBlock(i=값_있는_항목만_필터링) { i["HSD_DL"]["isSlab"]; }
code_block_15 = CodeBlock { ","; }
split = String.Split(string=code_block_14, separator0=code_block_15)
dict_forSlabBln = Python(IN[0]=code_block_13, IN[1]=split)  # CPython3
# ---------- dict_forSlabBln.python (64 lines) ----------
# Load the Python Standard and DesignScript Libraries
import sys
import clr
clr.AddReference('ProtoGeometry')
from Autodesk.DesignScript.Geometry import *
################Module For Functional Programing#########################
from functools import reduce; from itertools import chain
from itertools import groupby; import operator
from copy import deepcopy
curry = lambda f: lambda a,*args: f(a, *args) if (len(args)) else lambda *args: f(a, *args)

filter, map, reduce = curry(filter), curry(map), curry(reduce)

go = lambda *args: reduce(lambda a,f: f(a), args) ## 함수도 축약 가능 ##

def dictUpdate(dic1,dic2):
    dic1.update(dic2)
    return dic1
    
def dictsMerge(dics):
    res = reduce(dictUpdate, dics)
    return res
    
def dictDeleteKeys(dic, keys):
    for k in keys:
        del dic[k]
    return dic

def flat(a):
    if isinstance(a, list):
        for i in a: 
            yield from flat(i)
    else: yield a

def grpBy(iter, key):
    f,keys,grps = key,[],[]
    sorted_ = sorted(iter, key=f)
    for key, grp_data in groupby(sorted_,key=f):
        keys.append(key); grps.append(list(grp_data))
    return grps,keys
#########################################################################
# The inputs to this node will be stored as a list in the IN variables.
dataEnteringNode = IN
lvsDict = IN[0]
json_input = IN[1]
# Place your code below this line
def dict_forSlabBln(json_input):
    cnt = len(json_input)
    storyStrs = list(map(lambda x: "0"+ str(x), range(0,cnt)))
    res = dict(zip(storyStrs, json_input))
    return res

def find_noMatch_LvName(lvsDict, jsonDict):
    dictKeys = lvsDict.keys()
    jsonKeys = jsonDict.keys()
    lastValuefromjsonDict = list(jsonDict.values())[-1]
    noMatchLv = list(set(dictKeys).difference(set(jsonKeys)))
    for i in noMatchLv:
        jsonDict[i] = lastValuefromjsonDict
    return jsonDict

jsonDict = dict_forSlabBln(json_input)
# Assign your output to the OUT variable.
OUT = find_noMatch_LvName(lvsDict, jsonDict)
# ----------------------------------------
code_block_16 = CodeBlock(i=값_있는_항목만_필터링) { i["HSD_DL"]["DL_info"]["value"]; }
toNumber = String.ToNumber(string=code_block_16)
dl_층별_정보_kn_m² = CodeBlock(i=toNumber) { i; }

code_block_17 = CodeBlock(jsonLvDict=dict_forSlabBln) { jsonLvDict; }
add_divSegment_Info = Python(IN[0]=all_beams, IN[1]=allGirdersDicts, IN[2]=code_block_17)  # CPython3
# ---------- add_divSegment_Info.python (91 lines) ----------
# Load the Python Standard and DesignScript Libraries
import sys
import clr
clr.AddReference('ProtoGeometry')
from Autodesk.DesignScript.Geometry import *
################Module For Functional Programing#########################
from functools import reduce; from itertools import chain
from itertools import groupby; import operator
from copy import deepcopy
from DSCore import List
curry = lambda f: lambda a,*args: f(a, *args) if (len(args)) else lambda *args: f(a, *args)

filter, map, reduce = curry(filter), curry(map), curry(reduce)

go = lambda *args: reduce(lambda a,f: f(a), args) ## 함수도 축약 가능 ##

def dictUpdate(dic1,dic2):
    dic1.update(dic2)
    return dic1
    
def dictsMerge(dics):
    res = reduce(dictUpdate, dics)
    return res
    
def dictDeleteKeys(dic, keys):
    for k in keys:
        del dic[k]
    return dic

def flat(a):
    if isinstance(a, list):
        for i in a: 
            yield from flat(i)
    else: yield a

def grpBy(iter, key):
    f,keys,grps = key,[],[]
    sorted_ = sorted(iter, key=f)
    for key, grp_data in groupby(sorted_,key=f):
        keys.append(key); grps.append(list(grp_data))
    return grps,keys
#########################################################################
# The inputs to this node will be stored as a list in the IN variables.
dataEnteringNode = IN
#allBeamsLocations = IN[0]
allBeamsDicts = IN[0]
allBeamsLocations = list(map(lambda x: x["location_line"], allBeamsDicts))
allGirdersDicts = IN[1]
lv_slab_info = IN[2]
# Place your code below this line
def extendBeamLocations(loc_crv, gap):
    extLine = loc_crv.ExtendStart(gap).ExtendEnd(gap)
    upSrf = extLine.Extrude(Vector.ByCoordinates(0,0,1), 100)
    blSrf = extLine.Extrude(Vector.ByCoordinates(0,0,-1), 100)
    res = PolySurface.ByJoinedSurfaces([upSrf, blSrf])
    return res

def find_segmentCnt(elemDict, allBeamsLocations):
    elemLine = elemDict["location_line"]
    res = []
    for beam in allBeamsLocations:
        intsct = elemLine.Intersect(beam)
        res.append( intsct )
    flattenRes = list(chain(*res))
    def find_coordiStr(pt):
        #res = ",".join([str(pt.X), str(pt.Y), str(pt.Z)])
        res = [pt.X, pt.Y, pt.Z]
        return res
        
    def find_uniqCoordiStrInPts(pts):
        allStrs = list(map(find_coordiStr, pts))
        return list(set(allStrs))
    
    segmentCnt = len( List.UniqueItems(flattenRes) ) + 1
    
    return segmentCnt

extended_allBeamsLocation = list(map(lambda x: extendBeamLocations(x,300), allBeamsLocations))

def add_divSegment_toDict(elemDict, allBeamsLocations, lv_slab_info):
    segmentCnt = find_segmentCnt(elemDict, allBeamsLocations)
    lvBelong = elemDict["lvBelong"]
    if lv_slab_info[lvBelong] == "on": # slab인 경우
        #elemDict["unbr_segment"] = 0
        elemDict["unbr_segment"] = 1
    elif lv_slab_info[lvBelong] == "off": # slab 아닌 경우
        elemDict["unbr_segment"] = segmentCnt
    return elemDict
    
# Assign your output to the OUT variable.
OUT = list(map(lambda x: add_divSegment_toDict(x, extended_allBeamsLocation, lv_slab_info), allGirdersDicts))
# ----------------------------------------
add_AttachedGirderLength_toBeamDict = Python(IN[0]=all_beams, IN[1]=add_divSegment_Info)  # CPython3
# ---------- add_AttachedGirderLength_toBeamDict.python (81 lines) ----------
# Load the Python Standard and DesignScript Libraries
import sys
import clr
clr.AddReference('ProtoGeometry')
from Autodesk.DesignScript.Geometry import *
################Module For Functional Programing#########################
from functools import reduce; from itertools import chain
from itertools import groupby; import operator
from copy import deepcopy
from DSCore import List
curry = lambda f: lambda a,*args: f(a, *args) if (len(args)) else lambda *args: f(a, *args)

filter, map, reduce = curry(filter), curry(map), curry(reduce)

go = lambda *args: reduce(lambda a,f: f(a), args) ## 함수도 축약 가능 ##

def dictUpdate(dic1,dic2):
    dic1.update(dic2)
    return dic1
    
def dictsMerge(dics):
    res = reduce(dictUpdate, dics)
    return res
    
def dictDeleteKeys(dic, keys):
    for k in keys:
        del dic[k]
    return dic

def flat(a):
    if isinstance(a, list):
        for i in a: 
            yield from flat(i)
    else: yield a

def grpBy(iter, key):
    f,keys,grps = key,[],[]
    sorted_ = sorted(iter, key=f)
    for key, grp_data in groupby(sorted_,key=f):
        keys.append(key); grps.append(list(grp_data))
    return grps,keys
#########################################################################

# The inputs to this node will be stored as a list in the IN variables.
dataEnteringNode = IN
allBeamsDicts = IN[0]
allGirdersDicts = IN[1]
allGirdersLocations = list(map(lambda x: x["location_line"], allGirdersDicts))
# Place your code below this line
def find_attachedGirderDict(elemDict, allGirdersDicts):
    elemLine = elemDict["location_line"]
    res = go(
        allGirdersDicts,
        
        filter(lambda x: elemLine.DoesIntersect(x["location_line"])),
#        map(lambda x: x.Length),
        list,
        lambda x: x[0], 
    )
    return res
    
def find_attachedGirderLength(elemDict, allGirdersLocations):
    elemLine = elemDict["location_line"]
    res = go(
        allGirdersLocations,
        filter(lambda x: elemLine.DoesIntersect(x)),
        map(lambda x: x.Length),
        list,
        lambda x: x[0], 
    )
    return res
    
def add_attachedGirderInfo_toDict(elemDict, allGirdersLocations):
    #if elemDict["role"] == "beam"
    attachedGirderLength = find_attachedGirderDict(elemDict, allGirdersDicts)["length"]
    attchedGirder_Unbr_segment = find_attachedGirderDict(elemDict, allGirdersDicts)["unbr_segment"]
    elemDict["attch_girderLength"] = attachedGirderLength
    elemDict["attch_girder_unbr_segment"] = attchedGirder_Unbr_segment
    return elemDict
# Assign your output to the OUT variable.
OUT = list(map(lambda x: add_attachedGirderInfo_toDict(x, allGirdersLocations), allBeamsDicts))
# ----------------------------------------
join = List.Join(list0=add_AttachedGirderLength_toBeamDict, list1=add_divSegment_Info)
add_sectionProperties = Python(IN[0]=join)  # CPython3
# ---------- add_sectionProperties.python (110 lines) ----------
# Load the Python Standard and DesignScript Libraries
import sys
import clr
clr.AddReference('ProtoGeometry')
from Autodesk.DesignScript.Geometry import *
################Module For Functional Programing#########################
from functools import reduce; from itertools import chain
from itertools import groupby; import operator
from copy import deepcopy
from DSCore import List
curry = lambda f: lambda a,*args: f(a, *args) if (len(args)) else lambda *args: f(a, *args)

filter, map, reduce = curry(filter), curry(map), curry(reduce)

go = lambda *args: reduce(lambda a,f: f(a), args) ## 함수도 축약 가능 ##

def dictUpdate(dic1,dic2):
    dic1.update(dic2)
    return dic1
    
def dictsMerge(dics):
    res = reduce(dictUpdate, dics)
    return res
    
def dictDeleteKeys(dic, keys):
    for k in keys:
        del dic[k]
    return dic

def flat(a):
    if isinstance(a, list):
        for i in a: 
            yield from flat(i)
    else: yield a

def grpBy(iter, key):
    f,keys,grps = key,[],[]
    sorted_ = sorted(iter, key=f)
    for key, grp_data in groupby(sorted_,key=f):
        keys.append(key); grps.append(list(grp_data))
    return grps,keys
#########################################################################
# The inputs to this node will be stored as a list in the IN variables.
dataEnteringNode = IN
allElemsDicts = IN[0]
# Place your code below this line
def add_sectionPropsToDict(elemDict):
    elem = elemDict["elem"]
    sectionID = elemDict["sectionProp"]["name"]#.split('_')[-1]
    Area = elemDict["sectionProp"]["A"]
    SW = Area*77.22/10**6 * (10**2)
    
    tw = elem.GetParameterValueByName("Family and Type")\
        .GetParameterValueByName("Web Thickness") * 10
    tf = elem.GetParameterValueByName("Family and Type")\
        .GetParameterValueByName("Flange Thickness") * 10
    D = elem.GetParameterValueByName("Family and Type")\
        .GetParameterValueByName("Height") * 10
    W = elem.GetParameterValueByName("Family and Type")\
        .GetParameterValueByName("Width") * 10
    radi = elem.GetParameterValueByName("Family and Type")\
        .GetParameterValueByName("Web Fillet") * 10
        
    Iyy = \
        (2*(W*tf**3/12+W*tf*((D-2*tf)/2+tf/2)**2)+tw*(D-2*tf)**3/12)
    Izz = \
        2*(tf*(W)**3/12)+(D-2*tf)*(tw)**3/12
    Syy = Iyy/(D/2)
    Szz = Izz/(W/2)
    Zyy = W*tf*(D-tf)+0.25*(D-2*tf)**2*tw
    Zzz = 0.5*(W)**2*tf+0.25*(D-2*tf)*(tw)**2
    
    J = (2*W*tf**3+(D-tf)*tw**3)/3
    
    Cwp = (D-tf)**2*W**3*tf/24
    
    ry = (Iyy/Area)**0.5
    rz = (Izz/Area)**0.5
    rts = ((Izz*Cwp)**0.5/Syy)**0.5
    
    secDict = {
        "sectionID": sectionID,
        "sectionRotating": elem.GetParameterValueByName("Cross-Section Rotation"),
        "Area": Area,
        "SW": SW,
        "tw": tw,
        "tf": tf,
        "D": D,
        "W": W,
        "radi": radi,
        "Iyy": Iyy,
        "Izz": Izz,
        "Syy": Syy,
        "Szz": Szz,
        "Zyy": Zyy,
        "Zzz": Zzz,
        "J": J,
        "Cwp": Cwp,
        "ry": ry,
        "rz": rz,
        "rts": rts,
    }
    
    elemDict["secDict"] = secDict
    return elemDict


# Assign your output to the OUT variable.
#OUT = add_sectionPropsToDict(allElemsDicts[0])
OUT = map(add_sectionPropsToDict, allElemsDicts)
# ----------------------------------------
code_block_18 = CodeBlock(i=add_sectionProperties) { i["role"]=="Girders"; }
filterByBoolMask = List.FilterByBoolMask(list=add_sectionProperties, mask=code_block_18)
code_block_19 = CodeBlock(i=filterByBoolMask.in) { List.GroupByKey(i["elem"], i["elem"].GetParameterValueByName("Reference Level Elevation"))["groups"]; }
전층_경간_면_생성 = Python(IN[0]=concave_hull, IN[1]=code_block_19)  # CPython3
# ---------- 전층_경간_면_생성.python (144 lines) ----------
# Load the Python Standard and DesignScript Libraries
import sys
import clr
clr.AddReference('ProtoGeometry')
from Autodesk.DesignScript.Geometry import *
from Autodesk.DesignScript.Geometry import Line

from math import sqrt, hypot
from itertools import combinations
################Module For Functional Programing#########################
from functools import reduce; from itertools import chain
from itertools import groupby; import operator
from copy import deepcopy
curry = lambda f: lambda a,*args: f(a, *args) if (len(args)) else lambda *args: f(a, *args)

filter, map, reduce = curry(filter), curry(map), curry(reduce)

go = lambda *args: reduce(lambda a,f: f(a), args) ## 함수도 축약 가능 ##

def dictUpdate(dic1,dic2):
    dic1.update(dic2)
    return dic1
    
def dictsMerge(dics):
    res = reduce(dictUpdate, dics)
    return res
    
def dictDeleteKeys(dic, keys):
    for k in keys:
        del dic[k]
    return dic

def flat(a):
    if isinstance(a, list):
        for i in a: 
            yield from flat(i)
    else: yield a

def grpBy(iter, key):
    f,keys,grps = key,[],[]
    sorted_ = sorted(iter, key=f)
    for key, grp_data in groupby(sorted_,key=f):
        keys.append(key); grps.append(list(grp_data))
    return grps,keys
#########################################################################
    
# The inputs to this node will be stored as a list in the IN variables.
dataEnteringNode = IN
concave_hull = IN[0]
#loadPerLevel = IN[1]
elems_forAllLv = IN[1]
#gridsX, gridsY = grids

# Place your code below this line


def grp_XYbeamsLinesPerLv(elemsPerLv):
    allLines = go(
        elemsPerLv,
        map(lambda x: x.GetLocation()),
        list,
    )
    directionsPerLevel = go(
        allLines,
        map(lambda x: x.Direction),
        map(lambda x: x.Normalized()),
        list,
    )
    
    isParallel = lambda e: go(
        e,
        lambda x: x.Direction,
        lambda x: x.Normalized(),
        lambda x: not x.IsParallel(directionsPerLevel[0]),
    )
    
    
    return grpBy(allLines, isParallel)[0]

def make_pairFrames(xGrps, yGrps):
    pairX = go(
        xGrps,
        lambda x: sorted(x, key=lambda e: e.StartPoint.X),
        lambda x: grpBy(x, key=lambda e: e.StartPoint.X)[0],
        map(lambda x: sorted(x, key=lambda e: e.StartPoint.Y)),
        #2개씩 1간격으로 서브리스트 생성
        map(lambda x: list(map(lambda n: x[n:n+1+1], range(len(x))[:-1]))),
        lambda x: list(chain(*x)),
    )
    pairY = go(
        yGrps,
        lambda x: sorted(x, key=lambda e: e.StartPoint.X),
        lambda x: grpBy(x, key=lambda e: e.StartPoint.X)[0],
        map(lambda x: sorted(x, key=lambda e: e.StartPoint.Y)),list,
        #2개씩 1간격으로 서브리스트 생성
        lambda x: list(map(lambda n: x[n:n+1+1], range(len(x))[:-1])),
        # 서브리스트 구조 Transpose
        map(lambda x: list(zip(*chain(x)))),
        lambda x: list(chain(*x)),
    )
    return pairX, pairY

def get_IntersectInGrp(xGrp, yGrp):
    res = []
    for x in xGrp:
        for y in yGrp:
            res.append(x.Intersect(y))
    return list(chain(*res))

def GetBoundingSrfs(intscts):
    res = []
    try:
        crvSet = concave_hull(intscts, 100000)
        polyCrv = PolyCurve.ByJoinedCurves(crvSet)
        srf = Surface.ByPatch(polyCrv)
        srfThick = srf.Thicken(10,False)
#        bdCube = BoundingBox.ByGeometry(srfThick).ToCuboid()
#        bdCubeSrfs = bdCube.Explode()
#        bdBelowSrf = go(
#            bdCube.Explode(),
#            #bdCubeSrfs,
#            filter(lambda x: x.NormalAtParameter(0.5,0.5).Z != 0),
#            list,
#        )[0]
        return srf
    except: pass

def makeSrf_btwnFrame(xGrps, yGrps):
    res = []
    for xGrp in xGrps:
        for yGrp in yGrps:
            intscts = get_IntersectInGrp(xGrp, yGrp)
            if GetBoundingSrfs(intscts):
                res.append(GetBoundingSrfs(intscts))

    return res


# Assign your output to the OUT variable.
XY_elems_forAllLv = list(map(grp_XYbeamsLinesPerLv, elems_forAllLv))
pairFrames_forAllLv = list(map(lambda x: list(make_pairFrames(*x)), XY_elems_forAllLv))
srfs_forAllLv = list(map(lambda x: list(makeSrf_btwnFrame(*x)), pairFrames_forAllLv))

OUT = srfs_forAllLv
# ----------------------------------------
전층_경간면_내부_등분선_찾기 = Python(IN[0]=concave_hull, IN[1]=전층_경간_면_생성)  # CPython3
# ---------- 전층_경간면_내부_등분선_찾기.python (168 lines) ----------
# Load the Python Standard and DesignScript Libraries
import sys
import clr
clr.AddReference('ProtoGeometry')
from Autodesk.DesignScript.Geometry import *

################Module For Functional Programing#########################
from functools import reduce; from itertools import chain
from itertools import groupby; import operator
from copy import deepcopy
curry = lambda f: lambda a,*args: f(a, *args) if (len(args)) else lambda *args: f(a, *args)

filter, map, reduce = curry(filter), curry(map), curry(reduce)

go = lambda *args: reduce(lambda a,f: f(a), args) ## 함수도 축약 가능 ##

def dictUpdate(dic1,dic2):
    dic1.update(dic2)
    return dic1
    
def dictsMerge(dics):
    res = reduce(dictUpdate, dics)
    return res
    
def dictDeleteKeys(dic, keys):
    for k in keys:
        del dic[k]
    return dic

def flat(a):
    if isinstance(a, list):
        for i in a: 
            yield from flat(i)
    else: yield a

def grpBy(iter, key):
    f,keys,grps = key,[],[]
    sorted_ = sorted(iter, key=f)
    for key, grp_data in groupby(sorted_,key=f):
        keys.append(key); grps.append(list(grp_data))
    return grps,keys
#########################################################################


# The inputs to this node will be stored as a list in the IN variables.
dataEnteringNode = IN
concave_hull = IN[0]
srfs_forAllLv = IN[1]
# Place your code below this line

def find_allCorner(srf):
    u_stt = srf.PointAtParameter(0,1)
    u_end = srf.PointAtParameter(1,1)
    b_stt = srf.PointAtParameter(0,0)
    b_end = srf.PointAtParameter(1,0)
    
    return u_stt, u_end, b_stt, b_end

def find_shortSide(srf):
    u_stt, u_end, b_stt, b_end = find_allCorner(srf)
    u_shortSide = Line.ByStartPointEndPoint(u_stt, u_end)
    b_shortSide = Line.ByStartPointEndPoint(b_stt, b_end)
    
    return u_shortSide, b_shortSide
    
def find_longSide(srf):
    u_stt, u_end, b_stt, b_end = find_allCorner(srf)
    l_longSide = Line.ByStartPointEndPoint(u_stt, b_stt)
    r_longSide = Line.ByStartPointEndPoint(u_end, b_end)
    
    return l_longSide, r_longSide
    
def find_longSide_midLine(srf):
    u_shortSide, b_shortSide = find_shortSide(srf)
    u_midPt = u_shortSide.PointAtParameter(0.5)
    b_midPt = b_shortSide.PointAtParameter(0.5)
    midLine = Line.ByStartPointEndPoint(u_midPt, b_midPt)
    
    return midLine

def find_2wayRefPts(srf):
    u_shortSide, b_shortSide = find_shortSide(srf)
    shortSideLength = u_shortSide.Length
    u_midPt = u_shortSide.PointAtParameter(0.5)
    b_midPt = b_shortSide.PointAtParameter(0.5)
    midLine = find_longSide_midLine(srf)
    midLineVec = midLine.Direction
    srfNormalVec = srf.NormalAtParameter(0.5,0.5)
    
    u_circle = Circle.ByCenterPointRadiusNormal(u_midPt, shortSideLength/2, srfNormalVec)
    b_circle = Circle.ByCenterPointRadiusNormal(b_midPt, shortSideLength/2, srfNormalVec)
    u_45d_pt = midLine.Intersect(u_circle)[0]
    b_45d_pt = midLine.Intersect(b_circle)[0]
    
    return u_45d_pt, b_45d_pt

def div_srf_1way(srf):
    u_stt, u_end, b_stt, b_end = find_allCorner(srf)
    u_shortSide, b_shortSide = find_shortSide(srf)
    u_midPt = u_shortSide.PointAtParameter(0.5)
    b_midPt = b_shortSide.PointAtParameter(0.5)
    
    l_srf = go(
        [u_stt, b_stt, u_midPt, b_midPt],
        lambda x: concave_hull(x, 100000),
        PolyCurve.ByJoinedCurves,
        Surface.ByPatch,
    )
    r_srf = go(
        [u_end, b_end, u_midPt, b_midPt],
        lambda x: concave_hull(x, 100000),
        PolyCurve.ByJoinedCurves,
        Surface.ByPatch,
    )
    
    return l_srf, r_srf

def div_srf_2way(srf):
    u_stt, u_end, b_stt, b_end = find_allCorner(srf)
    u_45d_pt, b_45d_pt = find_2wayRefPts(srf)
    
    l_srf = go(
        [u_stt, b_stt, u_45d_pt, b_45d_pt],
        #lambda x: concave_hull(x, 100000),  ## concave_hull 에서 근접점 오류 발생
        Polygon.ByPoints,
        PolyCurve.ByJoinedCurves,
        Surface.ByPatch,
    )
#    r_srf = go(
#        [u_end, b_end, u_45d_pt, b_45d_pt],
#        lambda x: concave_hull(x, 100000),
#        PolyCurve.ByJoinedCurves,
#        Surface.ByPatch,
#    )
#    u_srf =  go(
#        [u_stt, u_end, u_45d_pt],
#        lambda x: concave_hull(x, 100000),
#        PolyCurve.ByJoinedCurves,
#        Surface.ByPatch,
#    )
#    b_srf = go(
#        [b_stt, b_end, b_45d_pt],
#        lambda x: concave_hull(x, 100000),
#        PolyCurve.ByJoinedCurves,
#        Surface.ByPatch,
#    )
    
    return l_srf, r_srf, u_srf, b_srf

def div_srf(srf):
    u_stt, u_end, b_stt, b_end = find_allCorner(srf)
    shortSide = find_shortSide(srf)[0].Length
    longSide = find_longSide(srf)[0].Length
    ratio = longSide/shortSide
    
    if ratio < 2:
        #res = [{"srf": x, "load_path": "2way"} for x in div_srf_2way(srf)] ## srfDict 형태로 반환
        res = [{"srf": x, "load_path": "1way"} for x in div_srf_1way(srf)]
    elif ratio >= 2:
        res = [{"srf": x, "load_path": "1way"} for x in div_srf_1way(srf)]
    
    return res

def div_srf_perLv(srfsPerLv):
    return list(chain(*map(div_srf, srfsPerLv)))

# Assign your output to the OUT variable.
OUT = map(div_srf_perLv, srfs_forAllLv)
# ----------------------------------------
allGirdersDict = CodeBlock(i=filterByBoolMask.in) { i; }
element_별_하중srf_할당_frame = Python(IN[1]=전층_경간면_내부_등분선_찾기, IN[2]=allGirdersDict)  # CPython3; unwired: IN[0]
# ---------- element_별_하중srf_할당_frame.python (101 lines) ----------
# Load the Python Standard and DesignScript Libraries
import sys
import clr
clr.AddReference('ProtoGeometry')
from Autodesk.DesignScript.Geometry import *

################Module For Functional Programing#########################
from functools import reduce; from itertools import chain
from itertools import groupby; import operator
from copy import deepcopy
curry = lambda f: lambda a,*args: f(a, *args) if (len(args)) else lambda *args: f(a, *args)

filter, map, reduce = curry(filter), curry(map), curry(reduce)

go = lambda *args: reduce(lambda a,f: f(a), args) ## 함수도 축약 가능 ##

def dictUpdate(dic1,dic2):
    dic1.update(dic2)
    return dic1
    
def dictsMerge(dics):
    res = reduce(dictUpdate, dics)
    return res
    
def dictDeleteKeys(dic, keys):
    for k in keys:
        del dic[k]
    return dic

def flat(a):
    if isinstance(a, list):
        for i in a: 
            yield from flat(i)
    else: yield a

def grpBy(iter, key):
    f,keys,grps = key,[],[]
    sorted_ = sorted(iter, key=f)
    for key, grp_data in groupby(sorted_,key=f):
        keys.append(key); grps.append(list(grp_data))
    return grps,keys
#########################################################################

# The inputs to this node will be stored as a list in the IN variables.
dataEnteringNode = IN
srfs_forAllLv = IN[1]
#elems_forAllLv = IN[2]
elemDicts = IN[2]
elemDicts_forAllLv = go(
    elemDicts,
    lambda x: grpBy(x, lambda e: e["elem"].GetParameterValueByName("Reference Level Elevation")),
    lambda x: x[0]
)
# Place your code below this line
elemDictsX_forAllLv = go(
    elemDicts_forAllLv,
    map(lambda x: grpBy(x, lambda d: d["planeDirection"])[0]),
    map(lambda x: x[1]),list,
)

elemDictsY_forAllLv = go(
    elemDicts_forAllLv,
    map(lambda x: grpBy(x, lambda d: d["planeDirection"])[0]),
    map(lambda x: x[1]),list,
)

def find_intsctSrfs(elemDict, srfs_perLv):
    
    elemLineforChck = elemDict["elem"]\
                        .GetLocation()\
                        .ExtendStart(-100)\
                        .ExtendEnd(-100)
    assignedSrfs = go(
        srfs_perLv,
        filter(lambda x: x["load_path"]=="1way"),
        filter(lambda x: elemLineforChck.DoesIntersect(x["srf"])),
        list,
    )
    elemDict["asgned_srfs"] = list(map(lambda x: x["srf"], assignedSrfs))
    elemDict["asgned_area"] = round(sum(list(map(lambda x: x["srf"].Area, assignedSrfs))),2)
    elemDict["load"] = {}
    
    return elemDict


def find_intsctSrfsPerLv(elemDictsPerLv, srfs_perLv):
    res = go(
        elemDictsPerLv,
        map(lambda x: find_intsctSrfs(x, srfs_perLv)),
        list
    )
    return res

res = go(
    elemDictsX_forAllLv,
    lambda x: list(zip(x, srfs_forAllLv)),
    map(lambda x: find_intsctSrfsPerLv(*x)),
)

# Assign your output to the OUT variable.
OUT = res
# ----------------------------------------
allCols_3 = CodeBlock(allCols=allCols) { allCols; }
dl_하중_값_계산 = Python(IN[0]=element_별_하중srf_할당_frame, IN[1]=allCols_3, IN[2]=dl_층별_정보_kn_m²)  # CPython3
# ---------- dl_하중_값_계산.python (82 lines) ----------
# Load the Python Standard and DesignScript Libraries
import sys
import clr
clr.AddReference('ProtoGeometry')
from Autodesk.DesignScript.Geometry import *

################Module For Functional Programing#########################
from functools import reduce; from itertools import chain
from itertools import groupby; import operator
from copy import deepcopy
curry = lambda f: lambda a,*args: f(a, *args) if (len(args)) else lambda *args: f(a, *args)

filter, map, reduce = curry(filter), curry(map), curry(reduce)

go = lambda *args: reduce(lambda a,f: f(a), args) ## 함수도 축약 가능 ##

def dictUpdate(dic1,dic2):
    dic1.update(dic2)
    return dic1
    
def dictsMerge(dics):
    res = reduce(dictUpdate, dics)
    return res
    
def dictDeleteKeys(dic, keys):
    for k in keys:
        del dic[k]
    return dic

def flat(a):
    if isinstance(a, list):
        for i in a: 
            yield from flat(i)
    else: yield a

def grpBy(iter, key):
    f,keys,grps = key,[],[]
    sorted_ = sorted(iter, key=f)
    for key, grp_data in groupby(sorted_,key=f):
        keys.append(key); grps.append(list(grp_data))
    return grps,keys
#########################################################################

# The inputs to this node will be stored as a list in the IN variables.
dataEnteringNode = IN
frameDict_forAllLv = IN[0]
allCols = IN[1]
DL_forAllLv = IN[2]
# Place your code below this line
allLvsDict_DL = go(
    frameDict_forAllLv,
    map(lambda DictsPerLv: 
        set(map(lambda d: d["lvBelong"], DictsPerLv))
    ), list,
    lambda x: chain(*x), list,sorted,
    lambda x: dict(zip(x, DL_forAllLv)),
)

def calcLoad(elemDict, loadKind, loadType, allLvsLoadDict):
    elemLv = elemDict["lvBelong"]
    elemLength = elemDict["length"]
    asgned_area = elemDict["asgned_area"]
    DL_unitValueforElem = allLvsLoadDict[elemLv]
    calcRes = DL_unitValueforElem * asgned_area / (1000) 
    resDict = {
        "load_type": loadType,
        "wx": 0,
        "wy": -calcRes / elemDict["length"],
    }
    
    elemDict["load"][loadKind] = resDict
    
    return elemDict

def calcLoadPerLv(elemDictsPerLv, loadKind, loadType, allLvsLoadDict):
    return list(map(lambda x: calcLoad(x, loadKind, loadType, allLvsLoadDict), elemDictsPerLv))

def calcLoad_forAllLv(elemDicts_forAllLv, loadKind, loadType, allLvsLoadDict):
    return list(map(lambda x: calcLoadPerLv(x, loadKind, loadType, allLvsLoadDict), elemDicts_forAllLv))

# Assign your output to the OUT variable.
OUT = calcLoad_forAllLv(frameDict_forAllLv, "DL", "uniform", allLvsDict_DL)
# ----------------------------------------

# group: LL input
code_block_20 = CodeBlock(i=값_있는_항목만_필터링) { i["HSD_LL"]["value"]; }
toNumber_2 = String.ToNumber(string=code_block_20)
ll_층별_정보_kn_m² = CodeBlock(i=toNumber_2) { i; }

ll_하중_값_계산 = Python(IN[0]=dl_하중_값_계산, IN[1]=allCols_3, IN[2]=ll_층별_정보_kn_m²)  # CPython3
# ---------- ll_하중_값_계산.python (82 lines) ----------
# Load the Python Standard and DesignScript Libraries
import sys
import clr
clr.AddReference('ProtoGeometry')
from Autodesk.DesignScript.Geometry import *

################Module For Functional Programing#########################
from functools import reduce; from itertools import chain
from itertools import groupby; import operator
from copy import deepcopy
curry = lambda f: lambda a,*args: f(a, *args) if (len(args)) else lambda *args: f(a, *args)

filter, map, reduce = curry(filter), curry(map), curry(reduce)

go = lambda *args: reduce(lambda a,f: f(a), args) ## 함수도 축약 가능 ##

def dictUpdate(dic1,dic2):
    dic1.update(dic2)
    return dic1
    
def dictsMerge(dics):
    res = reduce(dictUpdate, dics)
    return res
    
def dictDeleteKeys(dic, keys):
    for k in keys:
        del dic[k]
    return dic

def flat(a):
    if isinstance(a, list):
        for i in a: 
            yield from flat(i)
    else: yield a

def grpBy(iter, key):
    f,keys,grps = key,[],[]
    sorted_ = sorted(iter, key=f)
    for key, grp_data in groupby(sorted_,key=f):
        keys.append(key); grps.append(list(grp_data))
    return grps,keys
#########################################################################

# The inputs to this node will be stored as a list in the IN variables.
dataEnteringNode = IN
frameDict_forAllLv = IN[0]
allCols = IN[1]
LL_forAllLv = IN[2]
# Place your code below this line
allLvsDict_LL = go(
    frameDict_forAllLv,
    map(lambda DictsPerLv: 
        set(map(lambda d: d["lvBelong"], DictsPerLv))
    ), list,
    lambda x: chain(*x), list,sorted,
    lambda x: dict(zip(x, LL_forAllLv)),
)

def calcLoad(elemDict, loadKind, loadType, allLvsLoadDict):
    elemLv = elemDict["lvBelong"]
    elemLength = elemDict["length"]
    asgned_area = elemDict["asgned_area"]
    LL_unitValueforElem = allLvsLoadDict[elemLv]
    calcRes = LL_unitValueforElem * asgned_area / (1000) 
    resDict = {
        "load_type": loadType,
        "wx": 0,
        "wy": -calcRes / elemDict["length"],
    }
    
    elemDict["load"][loadKind] = resDict
    
    return elemDict

def calcLoadPerLv(elemDictsPerLv, loadKind, loadType, allLvsLoadDict):
    return list(map(lambda x: calcLoad(x, loadKind, loadType, allLvsLoadDict), elemDictsPerLv))

def calcLoad_forAllLv(elemDicts_forAllLv, loadKind, loadType, allLvsLoadDict):
    return list(map(lambda x: calcLoadPerLv(x, loadKind, loadType, allLvsLoadDict), elemDicts_forAllLv))

# Assign your output to the OUT variable.
OUT = calcLoad_forAllLv(frameDict_forAllLv, "LL", "uniform", allLvsDict_LL)
# ----------------------------------------
code_block_21 = CodeBlock(i=ll_하중_값_계산) { i["asgned_srfs"]; }
toDict_allCols = Python(IN[0]=allCols, IN[1]=getLevelsDict, IN[2]=longAxis, IN[3]=shortAxis, IN[4]=materialPropDict)  # CPython3
# ---------- toDict_allCols.python (183 lines) ----------
# Load the Python Standard and DesignScript Libraries
import sys
import clr
clr.AddReference('ProtoGeometry')
from Autodesk.DesignScript.Geometry import *

################Module For Functional Programing#########################
from functools import reduce; from itertools import chain
from itertools import groupby; import operator
from copy import deepcopy
curry = lambda f: lambda a,*args: f(a, *args) if (len(args)) else lambda *args: f(a, *args)

filter, map, reduce = curry(filter), curry(map), curry(reduce)

go = lambda *args: reduce(lambda a,f: f(a), args) ## 함수도 축약 가능 ##

def dictUpdate(dic1,dic2):
    dic1.update(dic2)
    return dic1
    
def dictsMerge(dics):
    res = reduce(dictUpdate, dics)
    return res
    
def dictDeleteKeys(dic, keys):
    for k in keys:
        del dic[k]
    return dic

def flat(a):
    if isinstance(a, list):
        for i in a: 
            yield from flat(i)
    else: yield a

def grpBy(iter, key):
    f,keys,grps = key,[],[]
    sorted_ = sorted(iter, key=f)
    for key, grp_data in groupby(sorted_,key=f):
        keys.append(key); grps.append(list(grp_data))
    return grps,keys
#########################################################################
# The inputs to this node will be stored as a list in the IN variables.
dataEnteringNode = IN
allLvsDict = IN[1]
allCols = IN[0]
frameNoDict = IN[2]
shortAxisNoDict = IN[3]
materialPropDict = IN[4]
# Place your code below this line
def get_BuilingBdBox(allCols):
    allCols_loc = list(map(lambda x: x.GetLocation(),allCols))
    bdBox = BoundingBox.ByGeometry(allCols_loc).ToCuboid()
    return bdBox

def getSideDict(allCols):
    allCols_loc = list(map(lambda x: x.GetLocation(),allCols))
    bdBoxFaces = get_BuilingBdBox(allCols).Explode()
    sideFaces = go(
        bdBoxFaces,
        filter(lambda x: x.NormalAtParameter(0.5,0.5).Z == 0),
        list,
    )
    resDict = go(
        ["south","west","north","east"],
        lambda x: zip(x, sideFaces),
        dict,
    )
    
    return resDict

def toDict_allCols(allCols, frameNoDict, allLvsDict, materialPropDict):

    def find_Ix(elem):
        _tw = elem.GetParameterValueByName("Family and Type")\
            .GetParameterValueByName("Web Thickness") * 10
        _tf = elem.GetParameterValueByName("Family and Type")\
            .GetParameterValueByName("Flange Thickness") * 10
        _h = elem.GetParameterValueByName("Family and Type")\
            .GetParameterValueByName("Height") * 10
        _bf = elem.GetParameterValueByName("Family and Type")\
            .GetParameterValueByName("Width") * 10
        
        Ix = (2*(_bf*_tf**3/12+_bf*_tf*((_h-2*_tf)/2+_tf/2)**2)+_tw*(_h-2*_tf)**3/12)
        Ix_revit = elem.GetParameterValueByName("Family and Type")\
            .GetParameterValueByName("Moment of Inertia strong axis") * 10**4
        return Ix_revit

    def find_numberNameByElem(elem, nameDict, axis):
        tgtDict = {
            "X": elem.GetLocation().StartPoint.X,
            "Y": elem.GetLocation().StartPoint.Y,
            "Z": elem.GetLocation().StartPoint.Z,
        }
        res = []
        tgt = tgtDict[axis]
        for k,v in list(nameDict.items()):
            if v == tgt:
                res.append(k)
        return res

    def find_numberNameByPt(pt, nameDict, axis):
        tgtDict = {
            "X": pt.X,
            "Y": pt.Y,
            "Z": pt.Z,
        }
        res = []
        tgt = tgtDict[axis]
        for k,v in list(nameDict.items()):
            if v == tgt:
                res.append(k)
        return res

    def find_nodeName(elem, frameNoDict, shortAxisNoDict, allLvsDict):
        sttPt = elem.GetLocation().StartPoint
        
        endPt = elem.GetLocation().EndPoint
        
        name_stt_X = find_numberNameByPt(sttPt, frameNoDict, "X")[0]
        name_stt_Y = find_numberNameByPt(sttPt, shortAxisNoDict, "Y")[0]
        name_stt_Z = find_numberNameByPt(sttPt, allLvsDict, "Z")[0]
        name_stt = "1" + name_stt_X + name_stt_Y + name_stt_Z
        
        sttNodeDict = dict([("name",name_stt), ("Y",sttPt.Y), ("Z",sttPt.Z)])
        
        name_end_X = find_numberNameByPt(endPt, frameNoDict, "X")[0]
        name_end_Y = find_numberNameByPt(endPt, shortAxisNoDict, "Y")[0]
        name_end_Z = find_numberNameByPt(endPt, allLvsDict, "Z")[0]
        name_end = "1" + name_end_X + name_end_Y + name_end_Z
        
        endNodeDict = dict([("name",name_end), ("Y",endPt.Y), ("Z",endPt.Z)])
        
        return sttNodeDict, endNodeDict

    sideDict = getSideDict(allCols)    
        
    def findSide(col, sideDict):
        res = []
        for k,v in list(sideDict.items()):
            if col.Geometry()[0].DoesIntersect(v):
                res.append(k)
        return res
    
    def convertElementName(elem, replaceIDX, replaceChar):
        element_name = list(find_nodeName(elem, frameNoDict, shortAxisNoDict, allLvsDict)[0]["name"])
        element_name[replaceIDX] = replaceChar
        element_name_modified = "".join(element_name)
        return element_name_modified
    
    resDict = go(
        allCols,
        map( lambda x: {
            "elem": x,
            "element_name": convertElementName(x, 0, "2"),
            "sectionProp":{
                "name": x.GetParameterValueByName("Type").GetParameterValueByName("Type Name"),
                "sectionRotating": x.GetParameterValueByName("Cross-Section Rotation"),
                "A": x.GetParameterValueByName("Family and Type")\
                .GetParameterValueByName("Section Area") * 10**2,
                "I": find_Ix(x),
            },
            "GUID": x.GetParameterValueByName("IfcGUID"),
            "role": "Column",
            "location_line": x.GetLocation(),
            "startNode": find_nodeName(x, frameNoDict, shortAxisNoDict, allLvsDict)[0],
            "endNode": find_nodeName(x, frameNoDict, shortAxisNoDict, allLvsDict)[1],
            "planeDirection": "n/a",
            "length": x.GetLocation().Length,
            "asgned_srfs": [],
            "asgned_area": 0,
            "frameNo": find_numberNameByElem(x, frameNoDict, "X")[0],
            "lvBelong": find_numberNameByElem(x, allLvsDict, "Z")[0],
            "sideBelong": findSide(x, sideDict),
            "materialPropDict": materialPropDict,
        } )
    )
    
    return resDict

res = toDict_allCols(allCols, frameNoDict, allLvsDict, materialPropDict)
# Assign your output to the OUT variable.
OUT = res
# ----------------------------------------
add_divSegment_Info_columns = Python(IN[0]=toDict_allCols)  # CPython3; unwired: IN[1], IN[2]
# ---------- add_divSegment_Info_columns.python (92 lines) ----------
# Load the Python Standard and DesignScript Libraries
import sys
import clr
clr.AddReference('ProtoGeometry')
from Autodesk.DesignScript.Geometry import *
################Module For Functional Programing#########################
from functools import reduce; from itertools import chain
from itertools import groupby; import operator
from copy import deepcopy
from DSCore import List
curry = lambda f: lambda a,*args: f(a, *args) if (len(args)) else lambda *args: f(a, *args)

filter, map, reduce = curry(filter), curry(map), curry(reduce)

go = lambda *args: reduce(lambda a,f: f(a), args) ## 함수도 축약 가능 ##

def dictUpdate(dic1,dic2):
    dic1.update(dic2)
    return dic1
    
def dictsMerge(dics):
    res = reduce(dictUpdate, dics)
    return res
    
def dictDeleteKeys(dic, keys):
    for k in keys:
        del dic[k]
    return dic

def flat(a):
    if isinstance(a, list):
        for i in a: 
            yield from flat(i)
    else: yield a

def grpBy(iter, key):
    f,keys,grps = key,[],[]
    sorted_ = sorted(iter, key=f)
    for key, grp_data in groupby(sorted_,key=f):
        keys.append(key); grps.append(list(grp_data))
    return grps,keys
#########################################################################
# The inputs to this node will be stored as a list in the IN variables.
dataEnteringNode = IN
#allBeamsLocations = IN[0]
allColsDicts = IN[0]
#allBeamsLocations = list(map(lambda x: x["location_line"], allBeamsDicts))
#allGirdersDicts = IN[1]
#lv_slab_info = IN[2]
# Place your code below this line
def extendBeamLocations(loc_crv, gap):
    extLine = loc_crv.ExtendStart(gap).ExtendEnd(gap)
    upSrf = extLine.Extrude(Vector.ByCoordinates(0,0,1), 100)
    blSrf = extLine.Extrude(Vector.ByCoordinates(0,0,-1), 100)
    res = PolySurface.ByJoinedSurfaces([upSrf, blSrf])
    return res

def find_segmentCnt(elemDict, allBeamsLocations):
    elemLine = elemDict["location_line"]
    res = []
    for beam in allBeamsLocations:
        intsct = elemLine.Intersect(beam)
        res.append( intsct )
    flattenRes = list(chain(*res))
    def find_coordiStr(pt):
        #res = ",".join([str(pt.X), str(pt.Y), str(pt.Z)])
        res = [pt.X, pt.Y, pt.Z]
        return res
        
    def find_uniqCoordiStrInPts(pts):
        allStrs = list(map(find_coordiStr, pts))
        return list(set(allStrs))
    
    segmentCnt = len( List.UniqueItems(flattenRes) ) + 1
    
    return segmentCnt

#extended_allBeamsLocation = list(map(lambda x: extendBeamLocations(x,300), allBeamsLocations))

def add_divSegment_toDict(elemDict):
#    segmentCnt = find_segmentCnt(elemDict, allBeamsLocations)
#    lvBelong = elemDict["lvBelong"]
#    if lv_slab_info[lvBelong] == "on": # slab인 경우
#        #elemDict["unbr_segment"] = 0
#        elemDict["unbr_segment"] = 1
#    elif lv_slab_info[lvBelong] == "off": # slab 아닌 경우
#        elemDict["unbr_segment"] = segmentCnt
    elemDict["unbr_segment"] = 1
    return elemDict
    
# Assign your output to the OUT variable.
OUT = list(map(lambda x: add_divSegment_toDict(x), allColsDicts))
# ----------------------------------------
add_sectionProperties_2 = Python(IN[0]=add_divSegment_Info_columns)  # CPython3; same code as add_sectionProperties
# note: boundary 없는 부재는 아예 노드 속성에 boundary 키가 없도록
최하단_기둥_지점조건_부여 = Python(IN[0]=add_sectionProperties_2)  # CPython3
# ---------- 최하단_기둥_지점조건_부여.python (84 lines) ----------
# Load the Python Standard and DesignScript Libraries
import sys
import clr
clr.AddReference('ProtoGeometry')
from Autodesk.DesignScript.Geometry import *

################Module For Functional Programing#########################
from functools import reduce; from itertools import chain
from itertools import groupby; import operator
from copy import deepcopy
curry = lambda f: lambda a,*args: f(a, *args) if (len(args)) else lambda *args: f(a, *args)

filter, map, reduce = curry(filter), curry(map), curry(reduce)

go = lambda *args: reduce(lambda a,f: f(a), args) ## 함수도 축약 가능 ##

def dictUpdate(dic1,dic2):
    dic1.update(dic2)
    return dic1
    
def dictsMerge(dics):
    res = reduce(dictUpdate, dics)
    return res
    
def dictDeleteKeys(dic, keys):
    for k in keys:
        del dic[k]
    return dic

def flat(a):
    if isinstance(a, list):
        for i in a: 
            yield from flat(i)
    else: yield a

def grpBy(iter, key):
    f,keys,grps = key,[],[]
    sorted_ = sorted(iter, key=f)
    for key, grp_data in groupby(sorted_,key=f):
        keys.append(key); grps.append(list(grp_data))
    return grps,keys
#########################################################################
# The inputs to this node will be stored as a list in the IN variables.
dataEnteringNode = IN
allColDicts = IN[0]

# Place your code below this line
def find_btmCols(allColDicts):
    t = go(
        allColDicts,
        filter(lambda x: min([x["startNode"]["Z"],x["endNode"]["Z"]]) == 0),
        list,
    )
    f = go(
        allColDicts,
        filter(lambda x: min([x["startNode"]["Z"],x["endNode"]["Z"]]) != 0),
        list,
    )
    return t,f

def add_bndryToColDict(elemDict, condition):
    elemDict["boundary"] = {
        "node_name": elemDict["startNode"]["name"],
        "condition": condition
    }
    return elemDict

def add_bndryToAllColDict(elemDicts, conditions):
    if isinstance(conditions[0],list):
        inputPairs = zip(elemDicts, conditions)
        res = list(map(lambda x: add_bndryToColDict(*x), elemDicts))
    elif not isinstance(conditions[0],list):
        res = list(map(lambda x: add_bndryToColDict(x, conditions), elemDicts))
    
    return res

btmCols, otherCols = find_btmCols(allColDicts)

new_btmCols = add_bndryToAllColDict(btmCols, [1,1,1])


res = new_btmCols + otherCols
# Assign your output to the OUT variable.
OUT = res
# ----------------------------------------
code_block_22 = CodeBlock(allColDicts=최하단_기둥_지점조건_부여) { allColDicts; }
code_block_23 = CodeBlock(i=code_block_22) { i["location_line"]; }
n1_구조형식 = CustomSelection("Steel", items={RC: "RC", Steel: "Steel"})  # "1. 구조형식"
flatten = List.Flatten(list=ll_하중_값_계산)
join_2 = List.Join(list0=flatten, list1=code_block_22)
code_block_24 = CodeBlock(i=join_2) { i["frameNo"]; }
groupByKey = List.GroupByKey(list=join_2, keys=code_block_24)
code_block_25 = CodeBlock(i=groupByKey.groups) { i[0]; }
code_block_26 = CodeBlock(i=code_block_25) { i["element_name"]; }
code_block_27 = CodeBlock(i=code_block_25) { i["element_name"]; }
code_block_28 = CodeBlock(i=code_block_25) { i["role"]=="Girders"; }
filterByBoolMask_2 = List.FilterByBoolMask(list=code_block_25, mask=code_block_28)
code_block_29 = CodeBlock(i=filterByBoolMask_2.in) { i["location_line"]; }
code_block_30 = CodeBlock(i=code_block_29) { i[4]; }
code_block_31 = CodeBlock(i=code_block_29) { i[5]; }
code_block_32 = CodeBlock(i=filterByBoolMask_2.in) { i[4]; }
code_block_33 = CodeBlock(i=code_block_32) { i["load"]["DL"]; }
code_block_34 = CodeBlock(i=filterByBoolMask_2.in) { i[5]; }
code_block_35 = CodeBlock(i=code_block_34) { i["load"]["DL"]; }
code_block_36 = CodeBlock(i=code_block_32) { i["lvBelong"]; }
code_block_37 = CodeBlock(i=code_block_34) { i["lvBelong"]; }
code_block_38 = CodeBlock(i=join_2) { i["role"]; }
code_block_39 = CodeBlock(i=all_beams) { i["location_line"]; }
code_block_40 = CodeBlock()
# ---------- code_block_40.designscript (6 lines) ----------
{
"01": "slab",
"02": "slab",
"03": "non-slab",
"04": "non-slab"
};
# ----------------------------------------
code_block_41 = CodeBlock(i=filterByBoolMask.in) { i; }
code_block_42 = CodeBlock(i=code_block_41) { i["unbr_segment"]; }
code_block_43 = CodeBlock(i=code_block_42) { i!=0; }
countTrue = List.CountTrue(list=code_block_43)
code_block_44 = CodeBlock(i=allGirdersDicts) { i["lvBelong"]; }
filterByBoolMask_3 = List.FilterByBoolMask(list=code_block_41, mask=code_block_43)
code_block_45 = CodeBlock(i=filterByBoolMask_3.in) { i["location_line"]; }
code_block_46 = CodeBlock(i=join_2) { i; }
code_block_47 = CodeBlock(i=code_block_46) { i["frameNo"]; }
groupByKey_2 = List.GroupByKey(list=code_block_46, keys=code_block_47)
code_block_48 = CodeBlock(i=groupByKey_2.groups) { i[0]; }
code_block_49 = CodeBlock(i=code_block_48) { i["role"]=="Girders"; }
filterByBoolMask_4 = List.FilterByBoolMask(list=code_block_48, mask=code_block_49)
code_block_50 = CodeBlock(i=filterByBoolMask_4.in) { i; }
code_block_51 = CodeBlock(i=code_block_50) { i["load"]["DL"]; }
code_block_52 = CodeBlock(i=code_block_50) { i["location_line"]; }
code_block_53 = CodeBlock(i=code_block_50) { i["asgned_srfs"]; }
watch = Watch(ll_하중_값_계산)
allElems = List.Join(list0=all_elements_of_category, list1=all_elements_of_category_2)
code_block_54 = CodeBlock(i=allGirdersDicts) { i["elem"]; }
code_block_55 = CodeBlock(mode=code_block_2) { mode; }

# group: global area
code_block_56 = CodeBlock(allElems=allElems) { allElems; }
code_block_57 = CodeBlock(allElems=code_block_56) { allElems; }
code_block_58 = CodeBlock(mode=code_block_55) { mode; }
code_block_59 = CodeBlock(mode=code_block_58) { mode; }
code_block_60 = CodeBlock(folderPath=code_block_8) { folderPath; }
code_block_61 = CodeBlock(folderPath=code_block_60) { folderPath; }

# group: Load Distribution result export
code_block_62 = CodeBlock { "elem"; "location_line"; "asgned_srfs"; }
removeKeys = DesignScript.Builtin.Dictionary.RemoveKeys(dictionary=join_2, keys=code_block_62.out0)
removeKeys_2 = DesignScript.Builtin.Dictionary.RemoveKeys(dictionary=removeKeys, keys=code_block_62.out1)
removeKeys_3 = DesignScript.Builtin.Dictionary.RemoveKeys(dictionary=removeKeys_2, keys=code_block_62.out2)
code_block_63 = CodeBlock(i=removeKeys_3) { i; }
code_block_64 = CodeBlock(i=code_block_63) { i["frameNo"]; }
groupByKey_3 = List.GroupByKey(list=code_block_63, keys=code_block_64)
stringifyJSON = Data.StringifyJSON(values=groupByKey_3.groups)
code_block_65 = CodeBlock(folderPath=code_block_61) { folderPath; }
code_block_66 = CodeBlock { "HSD_load distribution"; }
하중분배결과파일_이름_생성 = Python(IN[0]=code_block_59, IN[1]=code_block_65, IN[2]=code_block_66, IN[3]=stringifyJSON)  # CPython3
# ---------- 하중분배결과파일_이름_생성.python (78 lines) ----------
# Load the Python Standard and DesignScript Libraries
import sys
import clr
clr.AddReference('ProtoGeometry')
from Autodesk.DesignScript.Geometry import *
import datetime
import os
################Module For Functional Programing#########################
from functools import reduce; from itertools import chain
from itertools import groupby; import operator
from copy import deepcopy
curry = lambda f: lambda a,*args: f(a, *args) if (len(args)) else lambda *args: f(a, *args)

filter, map, reduce = curry(filter), curry(map), curry(reduce)

go = lambda *args: reduce(lambda a,f: f(a), args) ## 함수도 축약 가능 ##

def dictUpdate(dic1,dic2):
    dic1.update(dic2)
    return dic1
    
def dictsMerge(dics):
    res = reduce(dictUpdate, dics)
    return res
    
def dictDeleteKeys(dic, keys):
    for k in keys:
        del dic[k]
    return dic

def flat(a):
    if isinstance(a, list):
        for i in a: 
            yield from flat(i)
    else: yield a

def grpBy(iter, key):
    f,keys,grps = key,[],[]
    sorted_ = sorted(iter, key=f)
    for key, grp_data in groupby(sorted_,key=f):
        keys.append(key); grps.append(list(grp_data))
    return grps,keys
#########################################################################
# The inputs to this node will be stored as a list in the IN variables.
dataEnteringNode = IN
executionMode = IN[0]
folderPath = IN[1]
fileNameMain = IN[2]
fileContent = IN[3]
# Place your code below this line
def getTimeStamp():
    #timeStr = datetime.datetime.now().strftime('_%Y-%m-%d_%H_%M')
    timeStr = datetime.datetime.now().strftime('_%Y-%m-%d_%H%M%S')
    res = timeStr
    return res

def make_resultFile(content, folderPath, fileName):
    if not os.path.exists(folderPath):
        os.makedirs(folderPath)
    fileNamefull = fileNameMain + getTimeStamp()
    filePath = f"{folderPath}\\{fileNamefull}.txt"
    f = open(filePath, 'w', encoding='utf8')
    f.write(content)
    f.close()
    return filePath

if executionMode == "하중분배모드":
    res = make_resultFile(fileContent, folderPath+'.\\loadDist', fileNameMain)
elif executionMode == "프레임해석모드":
    res = "프레임해석모드 완료"
elif executionMode == "부재해석모드":
    res = "부재해석모드 완료"
else:
    res = 0

#res = make_resultFile(fileContent, folderPath, fileNameMain)
# Assign your output to the OUT variable.
OUT = res
# ----------------------------------------

# group: Element_capacity_check_module
code_block_67 = CodeBlock(allElems=code_block_57) { allElems; }
code_block_68 = CodeBlock(allElems=code_block_67) { allElems; }
code_block_69 = CodeBlock { "IfcGUID"; }
getParameterValueByName = Element.GetParameterValueByName(element=code_block_68, parameterName=code_block_69)
code_block_70 = CodeBlock(mode=code_block_59) { mode; }
code_block_71 = CodeBlock(folderPath=code_block_61) { folderPath; }
code_block_72 = CodeBlock { "HSD_frame_module_IO"; }
filter_the_last_hsd_파일_and_read = Python(IN[0]=code_block_70, IN[1]=code_block_71, IN[2]=code_block_72)  # CPython3
# ---------- filter_the_last_hsd_파일_and_read.python (114 lines) ----------
# Load the Python Standard and DesignScript Libraries
import sys
import clr
clr.AddReference('ProtoGeometry')
from Autodesk.DesignScript.Geometry import *
import re
import os
import shutil
import json
import DSCore
################Module For Functional Programing#########################
from functools import reduce; from itertools import chain
from itertools import groupby; import operator
from copy import deepcopy
curry = lambda f: lambda a,*args: f(a, *args) if (len(args)) else lambda *args: f(a, *args)

filter, map, reduce = curry(filter), curry(map), curry(reduce)

go = lambda *args: reduce(lambda a,f: f(a), args) ## 함수도 축약 가능 ##

def dictUpdate(dic1,dic2):
    dic1.update(dic2)
    return dic1
    
def dictsMerge(dics):
    res = reduce(dictUpdate, dics)
    return res
    
def dictDeleteKeys(dic, keys):
    for k in keys:
        del dic[k]
    return dic

def flat(a):
    if isinstance(a, list):
        for i in a: 
            yield from flat(i)
    else: yield a

def grpBy(iter, key):
    f,keys,grps = key,[],[]
    sorted_ = sorted(iter, key=f)
    for key, grp_data in groupby(sorted_,key=f):
        keys.append(key); grps.append(list(grp_data))
    return grps,keys
#########################################################################
# The inputs to this node will be stored as a list in the IN variables.
dataEnteringNode = IN
executionMode = IN[0]
tmpPath = IN[1]
subPath = IN[2]
tgtPath = tmpPath + subPath

# Place your code below this line
def find_downloadPath():
    download = os.path.join(os.path.expanduser('~'), 'downloads')
    return download

def get_allSrcFromTemp(tmpPath):
    fileNames = os.listdir(tmpPath)
    res = list(map(lambda x: tmpPath + '\\' + x, fileNames))
    return res

def find_allHSD(fileNames, tgtStr):
    allHSDs = go(
        fileNames,
        filter(lambda x: tgtStr in x),
        list,
    )
    return allHSDs
    
def select_lastHSD(files):

    allCreatedTimes = list(map(lambda x: os.path.getctime(x), files))
    if len(files) == 1:
        res = files[0]
    elif len(files) > 1:
        res = go(
            zip(files,allCreatedTimes),list,
            lambda x: sorted(x, key=lambda x: x[1]),
            lambda x: x[-1][0],
        )
    return res
    
def readFile(path):
    #res = []
    with open(path, 'r', encoding='utf-8') as f:
        #res = f.readlines()
        res = f.read()
    return res
    


def getData_fromLatestFile(tgtPath, tgtStr):
    fileNames = get_allSrcFromTemp(tgtPath)
    all_data = find_allHSD(fileNames, tgtStr)
    latest_data = readFile(select_lastHSD(all_data))
    return latest_data



if executionMode == "부재해석모드":
#    res = [
#        DSCore.Data.ParseJSON(getData_fromLatestFile(tgtPath, "HSD_frame_result")),
#        DSCore.Data.ParseJSON(getData_fromLatestFile(tgtPath, "HSD_element_force")),
#        ]
    res = [
        json.loads(getData_fromLatestFile(tgtPath, "HSD_frame_result")),
        json.loads(getData_fromLatestFile(tgtPath, "HSD_element_force")),
        ]
elif executionMode != "부재해석모드":
    res = 0
# Assign your output to the OUT variable.
OUT = res#getData_fromLatestFile(tgtPath, "HSD_frame_result")
# ----------------------------------------
code_block_73 = CodeBlock(load_dist_result=stringifyJSON) { load_dist_result; }
parseJSON = Data.ParseJSON(json=code_block_73)
code_block_74 = CodeBlock()
# ---------- code_block_74.designscript (5 lines) ----------
globalRefDict = {
    "K": 1,
    "PhiP": 0.9,
    "PhiM": 0.9
};
# ----------------------------------------
chk_memberForce = Python(IN[0]=filter_the_last_hsd_파일_and_read, IN[1]=parseJSON, IN[2]=code_block_74)  # CPython3
# ---------- chk_memberForce.python (647 lines) ----------
# Load the Python Standard and DesignScript Libraries
import sys
import clr
clr.AddReference('ProtoGeometry')
from Autodesk.DesignScript.Geometry import *
import re
import os
import shutil
import json
import math
################Module For Functional Programing#########################
from functools import reduce; from itertools import chain
from itertools import groupby; import operator
from copy import deepcopy
curry = lambda f: lambda a,*args: f(a, *args) if (len(args)) else lambda *args: f(a, *args)

filter, map, reduce = curry(filter), curry(map), curry(reduce)

go = lambda *args: reduce(lambda a,f: f(a), args) ## 함수도 축약 가능 ##

def dictUpdate(dic1,dic2):
    dic1.update(dic2)
    return dic1
    
def dictsMerge(dics):
    res = reduce(dictUpdate, dics)
    return res
    
def dictDeleteKeys(dic, keys):
    for k in keys:
        del dic[k]
    return dic

def flat(a):
    if isinstance(a, list):
        for i in a: 
            yield from flat(i)
    else: yield a

def grpBy(iter, key):
    f,keys,grps = key,[],[]
    sorted_ = sorted(iter, key=f)
    for key, grp_data in groupby(sorted_,key=f):
        keys.append(key); grps.append(list(grp_data))
    return grps,keys
#########################################################################
# The inputs to this node will be stored as a list in the IN variables.
dataEnteringNode = IN
srcsFrom_frameModule = IN[0]
if srcsFrom_frameModule != 0:
    frameData = srcsFrom_frameModule[0]
    elemForceData = srcsFrom_frameModule[1]
else:
    pass
loadDistData = IN[1]
globalRefDict = IN[2]


# Place your code below this line
def makeUnionDict_forAllFrame(loadDistData, frameData, elemForceData):
    for_allFrame = loadDistData
    # testElem = testFrame[0]
    def makeUnionDictPerElem_byLoad(elemDict, load):
        elemName = elemDict["element_name"]
        
        newFy = elemDict["materialPropDict"]["Fy"]#/1000
        newE = elemDict["materialPropDict"]["E"]#/1000
        newG = elemDict["materialPropDict"]["G"]#/1000
        elemDict["materialPropDict"]["Fy"] = newFy
        elemDict["materialPropDict"]["E"] = newE
        elemDict["materialPropDict"]["G"] = newG
        
        tgtFrameNo = "frame" + str(int(elemDict["frameNo"])+1)
        tgtFrameData = frameData[tgtFrameNo][load]
        tgtEfData = elemForceData[tgtFrameNo][load]
        
        sttNodeName, endNodeName = elemDict["startNode"]["name"], elemDict["endNode"]["name"]
        sttNodeResult = tgtFrameData["node"][sttNodeName]
        endNodeResult = tgtFrameData["node"][endNodeName]
        elemDict["sttNodeResult"] = sttNodeResult
        elemDict["endNodeResult"] = endNodeResult
        
        elemForcesDict = tgtEfData[elemName]
        maxX = max(elemForcesDict["x"])
        maxP = max(elemForcesDict["P"])
        maxV = max(elemForcesDict["V"])
        maxMz = max(elemForcesDict["Mz"])
        
        loadDict = {
            load: {
                "P_list": elemForcesDict["P"],
                "Mz_list": elemForcesDict["Mz"],
                "V_list": elemForcesDict["V"],
                "Pu": maxP,
                "Muy": maxMz,
                "Muz": 0,
                "Vuy": 0,
                "Vuz": maxV,
            }
        }
        
        if "memberForce" in elemDict.keys():
            elemDict["memberForce"] = dict(elemDict["memberForce"], **loadDict)
        else:
            elemDict["memberForce"] = loadDict
        
        res = elemDict
        return res
    
    def makeUnionDictPerFrame_byLoad(elemDicts_perFrame, load):
        list(map(lambda x: makeUnionDictPerElem_byLoad(x,load), elemDicts_perFrame))
        return elemDicts_perFrame

    list(map(lambda elemDicts_perFrame: makeUnionDictPerFrame_byLoad(elemDicts_perFrame, "DL"), for_allFrame))
    res = list(map(lambda elemDicts_perFrame: makeUnionDictPerFrame_byLoad(elemDicts_perFrame, "LL"), for_allFrame))
    
    return for_allFrame
    
def Calculate_Slenderness_Ratio (globalRefDict, elemDict, n, Ly_):
    secDict = elemDict["secDict"]
    K, PhiP, PhiM = globalRefDict["K"], globalRefDict["PhiP"], globalRefDict["PhiM"]
    Lz_ = Ly_/n
    ry = secDict["ry"]
    rz = secDict["rz"]
    SR = max(K*Ly_/ry, K*Lz_/rz)

    return SR

def Calculate_Tensile_Strength (globalRefDict, elemDict) :
    secDict = elemDict["secDict"]
    Fy,E,u,G = elemDict["materialPropDict"]["Fy"], elemDict["materialPropDict"]["E"],\
           elemDict["materialPropDict"]["u"], elemDict["materialPropDict"]["G"]
    K, PhiP, PhiM = globalRefDict["K"], globalRefDict["PhiP"], globalRefDict["PhiM"]
    Ag = secDict["Area"]
    Pn = Fy*Ag

    ΦPn = PhiP * Pn

    return ΦPn

def Calculate_Flexural_Buckling(globalRefDict, elemDict,n,Ly_) : 
    secDict = elemDict["secDict"]
    Fy,E,u,G = elemDict["materialPropDict"]["Fy"], elemDict["materialPropDict"]["E"],\
           elemDict["materialPropDict"]["u"], elemDict["materialPropDict"]["G"]
    K, PhiP, PhiM = globalRefDict["K"], globalRefDict["PhiP"], globalRefDict["PhiM"]
    Lz_ = Ly_/n
    Ag = secDict["Area"]
    Iyy, Izz = secDict["Iyy"], secDict["Izz"]
    ry, rz = secDict["ry"], secDict["rz"]
    J, Cwp = secDict["J"], secDict["Cwp"]
    D, W = secDict["D"], secDict["W"]
    tw, tf, radi = secDict["tw"], secDict["tf"], secDict["radi"]
    
    SR = max(K*Ly_/ry, K*Lz_/rz)
    Fe1 = (math.pi**2)*E/(SR**2)
    Fe2 = ((math.pi**2)*E*Cwp/((K*Ly_)**2)+77.2*J)/(Iyy+Izz)
    Fe = Fe1
    # print(Fe1,Fe2)

    λrf = 0.56*math.sqrt(E/Fy)
    λrw = 1.49*math.sqrt(E/Fy)
    λf = W/(2*tf)
    λw = (D-2*tf-2*radi)/tw
    
    if SR <= 4.71*math.sqrt(E/(Fy)) : 
        Fn = 0.658**(Fy/Fe)*Fy
    else : 
        Fn = 0.877*Fe


    if (λrf > λf) and (λrw > λw) :      # Flexural Buckling of Member without Slender Element
        ΦPn = PhiP*Fn*Ag

    elif (λrf < λf) and (λrw > λw) :    # Flexural Buckling of Member with Slender Flange
        Fel = (1.49*(λrf/λf))**2*Fy
        if λf <= λrf*math.sqrt(Fy/Fn) : 
            Ae = Ag
        else : 
            be = (W/2)*(1-0.22*math.sqrt(Fel/Fn))*math.sqrt(Fel/Fn)
            Ae = Ag-((W-2*be)*tf)*2
        
        ΦPn = PhiP*Fn*Ae

    elif (λrf > λf) and (λrw < λw) :    # Flexural Buckling of Member with Slender Web
        Fel = (1.31*(λrw/λw))**2*Fy
        if λw <= λrw*math.sqrt(Fy/Fn) : 
            Ae = Ag
        else : 
            be = (D-2*tf-2*radi)*(1-0.18*math.sqrt(Fel/Fn))*math.sqrt(Fel/Fn)
            Ae = Ag-(((D-2*tf-2*radi)-be)*tw)

        ΦPn = PhiP*Fn*Ae

    else :                              # Flexural Buckling of Member with Slender Flange & Web
        Felf = (1.49*(λrf/λf))**2*Fy
        Felw = (1.31*(λrw/λw))**2*Fy
        if λf <= λrf*math.sqrt(Fy/Fn) and λw <= λrw*math.sqrt(Fy/Fn) : 
            Ae = Ag
        elif λf > λrf*math.sqrt(Fy/Fn) and λw <= λrw*math.sqrt(Fy/Fn) : 
            be = (W/2)*(1-0.22*math.sqrt(Felf/Fn))*math.sqrt(Felf/Fn)
            Ae = Ag-((W-2*be)*tf)*2
        elif λf <= λrf*math.sqrt(Fy/Fn) and λw > λrw*math.sqrt(Fy/Fn) : 
            be = (D-2*tf-2*radi)*(1-0.18*math.sqrt(Felw/Fn))*math.sqrt(Felw/Fn)
            Ae = Ag-(((D-2*tf-2*radi)-be)*tw)
        else : 
            be = (W/2)*(1-0.22*math.sqrt(Felf/Fn))*math.sqrt(Felf/Fn)
            he = (D-2*tf-2*radi)*(1-0.18*math.sqrt(Felw/Fn))*math.sqrt(Felw/Fn)
            Ae = (be*2*tf)*2+(he*tw)

        ΦPn = PhiP*Fn*Ae

    return ΦPn

def Calculate_Lateral_Torsional_Buckling(globalRefDict, elemDict,n,Ly_) : 
    secDict = elemDict["secDict"]
    Fy,E,u,G = elemDict["materialPropDict"]["Fy"], elemDict["materialPropDict"]["E"],\
           elemDict["materialPropDict"]["u"], elemDict["materialPropDict"]["G"]
    K, PhiP, PhiM = globalRefDict["K"], globalRefDict["PhiP"], globalRefDict["PhiM"]
    Syy, Zyy, Izz, rz = secDict["Syy"], secDict["Zyy"], secDict["Izz"], secDict["rz"]
    J, Cwp, D, W = secDict["J"], secDict["Cwp"], secDict["D"], secDict["W"]
    tw, tf, radi = secDict["tw"], secDict["tf"], secDict["radi"]
    Mp = Fy*Zyy
    Cb = 1.0

    λw = (D-2*tf-2*radi)/tw
    λpw = 3.76*math.sqrt(E/Fy)
    λrw = 5.70*math.sqrt(E/Fy)

    if n == 0 :
        Lz_ = 0
    else : 
        Lz_ = Ly_/n

    if λw <= λpw :                                       # Compact Web & Compact/Non-Compact/Slender Flange
        Lb = Lz_
        rts = math.sqrt(math.sqrt(Izz*Cwp)/Syy)
        Lp = 1.76*rz*math.sqrt(E/Fy)
        Lr = 1.95*rts*E/(0.7*Fy)*math.sqrt(J/(Syy*(D-tf))+math.sqrt((J/(Syy*(D-tf)))**2+6.76*(0.7*Fy/E)**2))
        Fcr = Cb*math.pi**2*E/(Lb/rts)**2*math.sqrt(1+0.078*J/(Syy*(D-tf))*(Lb/rts)**2)

        if Lb <= Lp : 
            Mny = Mp
        elif Lp < Lb <= Lr : 
            Mny = min(Cb*(Mp-(Mp-0.7*Fy*Syy)*(Lb-Lp)/(Lr-Lp)),Mp)
        elif Lb > Lr : 
            Mny = min(Fcr*Syy,Mp)

    elif λpw < λw <= λrw :                                # Non-Compact Web & Compact/Non-Compact/Slender Flange
        Lb = Lz_
        Izc = (tf*W**3)/12
        Syc = Syy
        Myc = Fy * Syc
        if Izc/Izz > 0.23 : 
            if λw <= λpw : 
                Rpc = Mp/Myc
                J_ = J
            else : 
                Rpc = min((Mp/Myc-(Mp/Myc-1)*(λw-λpw)/(λrw-λpw)),Mp-Myc)
                J_ = J
        else : 
            Rpc = 1
            J_ = 0

        FL = 0.7*Fy
        aw = ((D-2*tf-2*radi)*tw)/(W*tf)
        rt = W/math.sqrt(12*(1+1/6*aw))
        Lp = 1.1*rt*math.sqrt(E/Fy)
        Lr = 1.95*rt*(E/FL)*math.sqrt(J_/(Syy*(D-tf))+math.sqrt((J_/(Syy*(D-tf)))**2+6.76*(0.7*FL/E)**2))

        Fcr = Cb*math.pi**2*E/(Lb/rt)**2*math.sqrt(1+0.078*J_/(Syy*(D-tf))*(Lb/rt)**2)

        if Lb <= Lp : 
            Mny = Rpc*Myc
        elif Lp < Lb <= Lr : 
            Mny = min(Cb*(Rpc*Myc-(Rpc*Myc-0.7*FL*Syy)*(Lb-Lp)/(Lr-Lp)),Rpc*Myc)
        elif Lb > Lr : 
            Mny = min(Fcr*Syy,Rpc*Myc)

    else :                                                 # Slender Web & Compact/Non-Compact/Slender Flange
        Lb = Lz_
        Syc = Syy
        aw = ((D-2*tf-2*radi)*tw)/(W*tf)
        rt = W/math.sqrt(12*(1+1/6*aw))
        Lp = 1.1*rt*math.sqrt(E/Fy)
        Lr = math.pi*rt*math.sqrt(E/(0.7*Fy))
        Rpg = min(1-(aw/(1200+300*aw))*((D-2*tf-2*radi)/tw-5.7*math.sqrt(E/Fy)),1)

        if Lb <= Lp : 
            Mny = Rpg*Fy*Syc
        elif Lp < Lb <= Lr : 
            Fcr = Cb*(Fy-(0.3*Fy)*(Lb-Lp)/(Lr-Lp))
            Mny = min(Rpg*Fcr*Syc,Fy)
        elif Lb > Lr : 
            Fcr = Cb*math.pi**2*E/(Lb/((W/2)/math.sqrt(12*(1+1/6*(((D-2*tf-2*radi)*tw)/((W/2)*tf))))))**2
            Mny = min(Rpg*Fcr*Syc,Fy)

    ΦMny = PhiM*Mny

    return ΦMny

def Calculate_Compression_Flange_Local_Buckling(globalRefDict, elemDict) :
    secDict = elemDict["secDict"]
    Fy,E,u,G = elemDict["materialPropDict"]["Fy"], elemDict["materialPropDict"]["E"],\
           elemDict["materialPropDict"]["u"], elemDict["materialPropDict"]["G"]
    K, PhiP, PhiM = globalRefDict["K"], globalRefDict["PhiP"], globalRefDict["PhiM"]
    Syy, Zyy, Izz, rz = secDict["Syy"], secDict["Zyy"], secDict["Izz"], secDict["rz"]
    J, Cwp, D, W = secDict["J"], secDict["Cwp"], secDict["D"], secDict["W"]
    tw, tf, radi = secDict["tw"], secDict["tf"], secDict["radi"]
    Mp = Fy*Zyy

    λf = W/(2*tf)
    λw = (D-2*tf-2*radi)/tw
    λpf = 0.38*math.sqrt(E/Fy)
    λpw = 3.76*math.sqrt(E/Fy)
    λrf = 1.00*math.sqrt(E/Fy)
    λrw = 5.70*math.sqrt(E/Fy)

    if λw <= λpw :
        if λf <= λpf :                                                   # Compact Web & Compact Flange
            Mny = Mp
        elif λpf < λf <= λrf :                                           # Compact Web & Non-Compact Flange
            Mny = Mp-(Mp-0.7*Fy*Syy)*(λf-λpf)/(λrf-λpf)
        elif λrf < λf :                                                  # Compact Web & Slender Flange
            kc = min(max(4/(math.sqrt((D-2*tf-2*radi)/tw)),0.35),0.76)
            Mny = 0.9*E*kc*Syy/λf**2


    elif λpw < λw <= λrw :
        Izc = (tf*D**3)/12
        Syc = Syy
        Myc = Fy * Syc
        FL = 0.7*Fy
        if Izc/Izz > 0.23 : 
            if λw <= λpw : 
                Rpc = Mp/Myc
            else : 
                Rpc = min((Mp/Myc-(Mp/Myc-1)*(λw-λpw)/(λrw-λpw)),Mp-Myc)
        else : 
            Rpc = 1

        if λf <= λpf :                                                   # Non-Compact Web & Compact Flange
            Mny = Rpc*Myc
        elif λpf < λf <= λrf :                                           # Non-Compact Web & Non-Compact Flange
            Mny = Rpc*Myc-(Rpc*Myc-FL*Syc)*(λf-λpf)/(λrf-λpf)
        elif λrf < λf :                                                  # Non-Compact Web & Slender Flange
            kc = min(max(4/(math.sqrt((D-2*tf-2*radi)/tw)),0.35),0.76)
            Mny = 0.9*E*kc*Syc/λf**2

    elif λrw < λw : 
        Syc = Syy
        aw = ((D-2*tf-2*radi)*tw)/((W/2)*tf)
        Rpg = min(1-(aw/(1200+300*aw))*((D-2*tf-2*radi)/tw-5.7*math.sqrt(E/Fy)),1)

        if λf <= λpf :                                                   # Slender Web & Compact Flange
            Mny = Rpg*Fy*Syc
        elif λpf < λf <= λrf :                                           # Slender Web & Non-Compact Flange
            Fcr = Fy-(0.3*Fy)*(λf-λpf)/(λrf-λpf)
            Mny = Rpg*Fcr*Syc
        elif λrf < λf :                                                  # Slender Web & Slender Flange
            kc = min(max(4/(math.sqrt((D-2*tf-2*radi)/tw)),0.35),0.76)
            Fcr = 0.9*E*kc/λf**2
            Mny = Rpg*Fcr*Syc
    
    ΦMny = PhiM*Mny

    return ΦMny

def Calculate_Tension_Flange_Yielding(globalRefDict, elemDict) :
    secDict = elemDict["secDict"]
    Fy,E,u,G = elemDict["materialPropDict"]["Fy"], elemDict["materialPropDict"]["E"],\
           elemDict["materialPropDict"]["u"], elemDict["materialPropDict"]["G"]
    K, PhiP, PhiM = globalRefDict["K"], globalRefDict["PhiP"], globalRefDict["PhiM"]
    Syy, Zyy, Izz, rz = secDict["Syy"], secDict["Zyy"], secDict["Izz"], secDict["rz"]
    J, Cwp, D, W = secDict["J"], secDict["Cwp"], secDict["D"], secDict["W"]
    tw, tf, radi = secDict["tw"], secDict["tf"], secDict["radi"]
    Mp = Fy*Zyy

    λw = (D-2*tf-2*radi)/tw
    λpw = 3.76*math.sqrt(E/Fy)
    λrw = 5.70*math.sqrt(E/Fy)

    if λw <= λpw :
        Mny = Mp                                                            # Compact Web & Compact/Non-Compact/Slender Flange

    elif λpw < λw <= λrw :
        Mny = Mp                                                            # Non-Compact Web & Compact/Non-Compact/Slender Flange

    elif λrw < λw : 
        Mny = Mp                                                            # Slender Web & Compact/Non-Compact/Slender Flange

    ΦMny = PhiM*Mny

    return ΦMny

def Calculate_Minor_Axis_Flange_Local_Buckling(globalRefDict, elemDict) :
    secDict = elemDict["secDict"]
    Fy,E,u,G = elemDict["materialPropDict"]["Fy"], elemDict["materialPropDict"]["E"],\
           elemDict["materialPropDict"]["u"], elemDict["materialPropDict"]["G"]
    K, PhiP, PhiM = globalRefDict["K"], globalRefDict["PhiP"], globalRefDict["PhiM"]
    Szz, Zzz, Zyy, rz = secDict["Szz"], secDict["Zzz"], secDict["Zyy"], secDict["rz"]
    J, Cwp, D, W = secDict["J"], secDict["Cwp"], secDict["D"], secDict["W"]
    tw, tf, radi = secDict["tw"], secDict["tf"], secDict["radi"]
    Mp = Fy*Zyy

    λf = W/(2*tf)
    λpf = 0.38*math.sqrt(E/Fy)
    λrf = 1.00*math.sqrt(E/Fy)

    if λf <= λpf :                                                   # Compact Flange
        Mnz = min(Fy*Zzz, 1.6*Fy*Szz)
    elif λpf < λf <= λrf :                                           # Non-Compact Flange
        Mnz = Mp-(Mp-0.7*Fy*Szz)*(λf-λpf)/(λrf-λpf)
    elif λrf < λf :                                                  # lender Flange
        Fcr = 0.7*E/λf**2
        Mnz = Fcr*Szz

    ΦMnz = PhiM*Mnz

    return ΦMnz

def Calculate_Shear_Capacity(globalRefDict, elemDict) :
    secDict = elemDict["secDict"]
    Fy,E,u,G = elemDict["materialPropDict"]["Fy"], elemDict["materialPropDict"]["E"],\
           elemDict["materialPropDict"]["u"], elemDict["materialPropDict"]["G"]
    K, PhiP, PhiM = globalRefDict["K"], globalRefDict["PhiP"], globalRefDict["PhiM"]
    D,W = secDict["D"], secDict["W"], 
    tw,tf,radi = secDict["tw"], secDict["tf"], secDict["radi"]
    λw = (D-2*tf-2*radi)/tw
    λf = W/(2*tf)

    if λw <= 2.24*math.sqrt(E/Fy) : 
        Cv1 = 1.0
        PhiV = 1.0
    else : 
        if λw <= 1.1*math.sqrt(5.34*E/Fy) : 
            Cv1 = 1.0
            PhiV = 0.9
        else : 
            Cv1 = 1.1*math.sqrt(5.34*E/Fy)/λw
            PhiV = 0.9

    ΦVnz = PhiV*0.6*Fy*tw*D*Cv1      # Shear Strength of Webs

    if λf <= 1.1*math.sqrt(1.2*E/Fy) : 
        Cv2 = 1.0
        PhiV = 0.9
    elif 1.1*math.sqrt(1.2*E/Fy) < λf <= 1.37*math.sqrt(1.2*E/Fy) :
        Cv2 = 1.1*math.sqrt(1.2*E/Fy)/λw
        PhiV = 0.9
    else : 
        Cv2 = 1.51*1.2*E/(λw**2*Fy)
        PhiV = 0.9

    ΦVny = PhiV*0.6*Fy*W*tf*Cv2*2    # Shear Strength of Flanges

    return ΦVnz, ΦVny

def Calculate_Combined_Ratio(forceDict, Pc, Mcy, Mcz) :
    if abs( forceDict["Pu"]/Pc ) >= 0.2 : 
        CR = abs( forceDict["Pu"]/Pc ) + abs( (8/9)*(forceDict["Muy"]/Mcy+forceDict["Muz"]/Mcz) )
    else : 
        CR = abs(forceDict["Pu"]/(2*Pc)) + abs( (forceDict["Muy"]/Mcy+forceDict["Muz"]/Mcz) )
    
    #res = abs(forceDict["Pu"]/(2*Pc)), abs( (forceDict["Muy"]/Mcy+forceDict["Muz"]/Mcz) )
    return CR

def Calculate_Column_Capacity(globalRefDict, elemDict, load) :
    secDict = elemDict["secDict"]
    Fy,E,u,G = elemDict["materialPropDict"]["Fy"], elemDict["materialPropDict"]["E"],\
           elemDict["materialPropDict"]["u"], elemDict["materialPropDict"]["G"]
    K, PhiP, PhiM = globalRefDict["K"], globalRefDict["PhiP"], globalRefDict["PhiM"]
    materialPropDict = elemDict["materialPropDict"]
    elementType = elemDict["role"]
    forceDict = elemDict["memberForce"][load]
    length = elemDict["length"]
    # res = []
    n = elemDict['unbr_segment'] #Column_Unbraced_Segment
    SR = Calculate_Slenderness_Ratio(globalRefDict, elemDict,n,length)
    ΦPn1 = Calculate_Tensile_Strength(globalRefDict, elemDict)
    ΦPn2 = Calculate_Flexural_Buckling(globalRefDict, elemDict,n,length)
    if forceDict["Pu"] > 0 : 
        ΦPn = ΦPn1
    else : 
        ΦPn = ΦPn2
    ΦMny1 = Calculate_Lateral_Torsional_Buckling(globalRefDict, elemDict,n,length)
    ΦMny2 = Calculate_Compression_Flange_Local_Buckling(globalRefDict, elemDict)
    ΦMny3 = Calculate_Tension_Flange_Yielding(globalRefDict, elemDict)
    ΦMny = min(ΦMny1, ΦMny2, ΦMny3)
    ΦMnz = Calculate_Minor_Axis_Flange_Local_Buckling(globalRefDict, elemDict)
    ΦVnz, ΦVny = Calculate_Shear_Capacity(globalRefDict, elemDict)
    # CR = Calculate_Combined_Ratio(Column_Data[0], Column_Data[1], Column_Data[2], ΦPn, ΦMny, ΦMnz)
    # CR = Calculate_Combined_Ratio([Column_Data[0], Column_Data[1], Column_Data[2]], ΦPn, ΦMny, ΦMnz)
    CR = Calculate_Combined_Ratio(forceDict, ΦPn, ΦMny, ΦMnz)
    
    ratioDict = {
        "sectionName": secDict["sectionID"],
        "SR": SR,
        "ΦPn": ΦPn, 
        "ΦMny": ΦMny, 
        "ΦMnz": ΦMnz, 
        "ΦVnz": ΦVnz, 
        "ΦVny": ΦVny,
        "pRatio": abs(forceDict["Pu"])/ΦPn,
        "myRatio": abs(forceDict["Muy"])/ΦMny,
        "mzRatio": abs(forceDict["Muz"])/ΦMnz,
        "vzRatio": abs(forceDict["Vuz"])/ΦVnz,
        "vyRatio": abs(forceDict["Vuy"])/ΦVny,
        "combinedRatio": CR,
    }
    elemDict["ratioDict"] = ratioDict
    
    if ratioDict["SR"] < 200 and ratioDict["pRatio"]<1 and ratioDict["myRatio"]<1 and ratioDict["mzRatio"]<1 and ratioDict["vzRatio"]<1 and ratioDict["vyRatio"]<1 and ratioDict["combinedRatio"]<1 :
        elemDict["chk_result"] = 'OK'
    else : 
        elemDict["chk_result"] = 'NG'

    return elemDict

def Calculate_Girder_Beam_Capacity(globalRefDict, elemDict, load) :
    globalRefDict = globalRefDict
    secDict = elemDict["secDict"]
    Fy,E,u,G = elemDict["materialPropDict"]["Fy"], elemDict["materialPropDict"]["E"],\
           elemDict["materialPropDict"]["u"], elemDict["materialPropDict"]["G"]
    K, PhiP, PhiM = globalRefDict["K"], globalRefDict["PhiP"], globalRefDict["PhiM"]
    elementType = elemDict["role"]
    forceDict = elemDict["memberForce"][load]
    length = elemDict["length"]
    # res = []
    if elementType == 'Girders' :
        n = elemDict['unbr_segment'] #Girder_Unbraced_Segment
        SR = Calculate_Slenderness_Ratio(globalRefDict, elemDict,n,length)
        ΦPn1 = Calculate_Tensile_Strength(globalRefDict, elemDict)
        ΦPn2 = Calculate_Flexural_Buckling(globalRefDict, elemDict,n,length)
        if forceDict["Pu"] > 0 : 
            ΦPn = ΦPn1
        else : 
            ΦPn = ΦPn2
        ΦMny1 = Calculate_Lateral_Torsional_Buckling(globalRefDict, elemDict,n,length)
        ΦMny2 = Calculate_Compression_Flange_Local_Buckling(globalRefDict, elemDict)
        ΦMny3 = Calculate_Tension_Flange_Yielding(globalRefDict, elemDict)
        ΦMny = min(ΦMny1, ΦMny2, ΦMny3)
        ΦMnz = Calculate_Minor_Axis_Flange_Local_Buckling(globalRefDict, elemDict)
        ΦVnz, ΦVny = Calculate_Shear_Capacity(globalRefDict, elemDict)
        CR = Calculate_Combined_Ratio(forceDict, ΦPn, ΦMny, ΦMnz)

        ratioDict = {
        "sectionName": secDict["sectionID"],
        "SR": SR,
        "ΦPn": ΦPn, 
        "ΦMny": ΦMny, 
        "ΦMnz": ΦMnz, 
        "ΦVnz": ΦVnz, 
        "ΦVny": ΦVny,
        "pRatio": abs(forceDict["Pu"])/ΦPn,
        "myRatio": abs(forceDict["Muy"])/ΦMny,
        "mzRatio": abs(forceDict["Muz"])/ΦMnz,
        "vzRatio": abs(forceDict["Vuz"])/ΦVnz,
        "vyRatio": abs(forceDict["Vuy"])/ΦVny,
        "combinedRatio": CR,
         }   
        elemDict["ratioDict"] = ratioDict
        
        if ratioDict["SR"] < 200 and ratioDict["pRatio"]<1 and ratioDict["myRatio"]<1 and ratioDict["mzRatio"]<1 and ratioDict["vzRatio"]<1 and ratioDict["vyRatio"]<1 and ratioDict["combinedRatio"]<1 :
            elemDict["chk_result"] = 'OK'
        else : 
            elemDict["chk_result"] = 'NG'

    elif elementType == 'Beams' :
        attached_Girder_Length = elemDict["attch_girderLength"]
        attached_Girder_Unbraced_Segment = elemDict["attch_girder_unbr_segment"]
        n = 1
        SR = Calculate_Slenderness_Ratio(globalRefDict, elemDict,n, length)
        ## Brace 용도 / Start
        Lbr = attached_Girder_Length / attached_Girder_Unbraced_Segment
        Pr = forceDict["Pu"]
        Mr = forceDict["Muz"]
        Cd = 2
        ho = secDict["D"]
        Pbr = 0.01*Pr+0.02*(Mr*Cd/ho)
        βbr = 1/0.75*(8*Pr/Lbr)+1/0.75*(10*Mr*Cd/(Lbr*ho))
        Mbr = 2*length*Pbr/4
        Stiffness = 48*E*secDict["Zzz"]/(attached_Girder_Length*2)**3
        Stiffness_Ratio = βbr/Stiffness
        ## Brace 용도 / End
        ΦPn1 = Calculate_Tensile_Strength(globalRefDict, elemDict)
        ΦPn2 = Calculate_Flexural_Buckling(globalRefDict, elemDict,n,length)
        if forceDict["Pu"] > 0 : 
            ΦPn = ΦPn1
        else : 
            ΦPn = ΦPn2
        ΦMny1 = Calculate_Lateral_Torsional_Buckling(globalRefDict, elemDict,n,length)
        ΦMny2 = Calculate_Compression_Flange_Local_Buckling(globalRefDict, elemDict)
        ΦMny3 = Calculate_Tension_Flange_Yielding(globalRefDict, elemDict)
        ΦMny = min(ΦMny1, ΦMny2, ΦMny3)
        ΦMnz = Calculate_Minor_Axis_Flange_Local_Buckling(globalRefDict, elemDict)
        ΦVnz, ΦVny = Calculate_Shear_Capacity(globalRefDict, elemDict)
        # CR = Calculate_Combined_Ratio(Beam_Data[0], Beam_Data[1], Beam_Data[2], ΦPn, ΦMny, ΦMnz)
        CR = Calculate_Combined_Ratio(forceDict, ΦPn, ΦMny, ΦMnz)

        ratioDict = {
        "sectionName": secDict["Section_Name"],
        "SR": SR,
        "ΦPn": ΦPn, 
        "ΦMny": ΦMny, 
        "ΦMnz": ΦMnz, 
        "ΦVnz": ΦVnz, 
        "ΦVny": ΦVny,
        "pRatio": abs(forceDict["Pu"])/ΦPn,
        "myRatio": abs(forceDict["Muy"])/ΦMny,
        "mzRatio": abs(forceDict["Muz"])/ΦMnz,
        "vzRatio": abs(forceDict["Vuz"])/ΦVnz,
        "vyRatio": abs(forceDict["Vuy"])/ΦVny,
        "combinedRatio": CR,
         }   
        elemDict["ratioDict"] = ratioDict
        
        if ratioDict["SR"] < 200 and ratioDict["pRatio"]<1 and ratioDict["myRatio"]<1 and ratioDict["mzRatio"]<1 and ratioDict["vzRatio"]<1 and ratioDict["vyRatio"]<1 and ratioDict["combinedRatio"]<1 and Stiffness_Ratio<1 :
            elemDict["chk_result"] = 'OK'
        else : 
            elemDict["chk_result"] = 'NG'

    return elemDict

def Calculate_element_Capacity(globalRefDict, elemDict, load):
    elementType = elemDict["role"]
    if elementType == "Column":
        Calculate_Column_Capacity(globalRefDict, elemDict, load)
    elif elementType == "Girders" or elementType == "Beams":
        Calculate_Girder_Beam_Capacity(globalRefDict, elemDict, load)
    return elemDict


# Assign your output to the OUT variable.
if srcsFrom_frameModule != 0:
    allUnionDictsforAllFrame = list(chain(*makeUnionDict_forAllFrame(loadDistData, frameData, elemForceData)))

    total_res = go(
    allUnionDictsforAllFrame,
    map(lambda x: Calculate_element_Capacity(globalRefDict, x, "DL")),
    # map(lambda x: [x["element_name"],x["chk_result"]]),
    list,
    )
    total_res
else:
    total_res = 0
    
OUT = total_res
# ----------------------------------------
code_block_75 = CodeBlock { "HSD_member_analysis"; "HSD_member_analysis_ratio"; }
부재결과_속성_입력 = Python(IN[0]=chk_memberForce, IN[1]=code_block_68, IN[2]=code_block_75.out0, IN[3]=code_block_75.out1)  # CPython3
# ---------- 부재결과_속성_입력.python (90 lines) ----------
# Load the Python Standard and DesignScript Libraries
import sys
import clr
clr.AddReference('ProtoGeometry')
from Autodesk.DesignScript.Geometry import *
import re
import os
import shutil
import json
import math
################Module For Functional Programing#########################
from functools import reduce; from itertools import chain
from itertools import groupby; import operator
from copy import deepcopy
curry = lambda f: lambda a,*args: f(a, *args) if (len(args)) else lambda *args: f(a, *args)

filter, map, reduce = curry(filter), curry(map), curry(reduce)

go = lambda *args: reduce(lambda a,f: f(a), args) ## 함수도 축약 가능 ##

def dictUpdate(dic1,dic2):
    dic1.update(dic2)
    return dic1
    
def dictsMerge(dics):
    res = reduce(dictUpdate, dics)
    return res
    
def dictDeleteKeys(dic, keys):
    for k in keys:
        del dic[k]
    return dic

def flat(a):
    if isinstance(a, list):
        for i in a: 
            yield from flat(i)
    else: yield a

def grpBy(iter, key):
    f,keys,grps = key,[],[]
    sorted_ = sorted(iter, key=f)
    for key, grp_data in groupby(sorted_,key=f):
        keys.append(key); grps.append(list(grp_data))
    return grps,keys
#########################################################################
# The inputs to this node will be stored as a list in the IN variables.
dataEnteringNode = IN
memberDicts = IN[0]
allElems = IN[1]
analysis_result_paramName = IN[2]
analysis_ratio_paramName = IN[3]
# Place your code below this line
def find_elems_in_memberDicts(allElems, memberDicts):
    allMembersGUIDs = list(map(lambda x: x["GUID"], memberDicts))
    allMembersGUIDs_No = list(enumerate(allMembersGUIDs))
    
    elems_byMembersOrder = go(
        allElems,
        filter(lambda x: x.GetParameterValueByName("IfcGUID") in allMembersGUIDs),
        list,
        #map(lambda x: allMembersGUIDs.index(x.GetParameterValueByName("IfcGUID")))
        lambda x: sorted(x, key=lambda x: allMembersGUIDs.index(x.GetParameterValueByName("IfcGUID")))
    )
    return elems_byMembersOrder

def setResultParamToElem(elems_byMembersOrder, memberDicts, paramName):
    zippedList = zip(elems_byMembersOrder, memberDicts)
    res = go(
        zippedList, list,
        map(lambda x: x[0].SetParameterByName(paramName, x[1]["chk_result"])),
        list,
    )
def setRatioParamToElem(elems_byMembersOrder, memberDicts, paramName):
    zippedList = zip(elems_byMembersOrder, memberDicts)
    res = go(
        zippedList, list,
        map(lambda x: x[0].SetParameterByName(paramName, float(x[1]["ratioDict"]["combinedRatio"]))),
        list,
    )

if memberDicts != 0:
    elems_byMembersOrder = find_elems_in_memberDicts(allElems, memberDicts)
    setResultParamToElem(elems_byMembersOrder, memberDicts, analysis_result_paramName)
    res = setRatioParamToElem(elems_byMembersOrder, memberDicts, analysis_ratio_paramName)
else:
    res = 0
# Assign your output to the OUT variable.

OUT = res
# ----------------------------------------

HSD_frame_module = Python(IN[0]=code_block_59, IN[1]=code_block_65, IN[2]=stringifyJSON)  # CPython3
# ---------- HSD_frame_module.python (106 lines) ----------
# Load the Python Standard and DesignScript Libraries
import os
import sys
import clr
clr.AddReference('ProtoGeometry')
from Autodesk.DesignScript.Geometry import *


# The inputs to this node will be stored as a list in the IN variables.
dataEnteringNode = IN
HSD_module_refPath = IN[1]

sys.path.append(HSD_module_refPath)
sys.path.append(HSD_module_refPath+ "\\HSD_frame_module\\en_2dstruct")
#import HSD_frame_module
#from HSD_frame_module import en_2dstruct
from HSD_frame_module.en_2dstruct.userfunction import *
from HSD_frame_module.en_2dstruct.r2f import *
import copy
import os
import json

frame_dict_json = IN[2]
executionMode = IN[0]
# Place your code below this line

## 폴더이름문자열 텍스트파일: 현재 exe 경로에서 
## tgtPath = 읽어온 텍스트 내용

#file1 = open('HSD_model_path.txt','r', encoding='UTF8')
#indata = file1.readlines()
#file1.close()

targetpath = HSD_module_refPath#indata[0]

#if targetpath == '':
#    os.chdir(targetpath)
#
#foldername = 'HSD_frame_module_IO' #
#foldername = targetpath + "\\HSD_frame_module\\HSD_frame_module_IO"
inputFolderName = targetpath + "\\loadDist"
outputFolderName = targetpath + "\\HSD_frame_module_IO"
filename = findReadFile(inputFolderName,'HSD_load distribution')
#path = foldername+'/'+filename

def createResult_frameModule(frame_dict_json, filename, outputFolderName):
    runtime = getTimeStamp()
    
    #frame_dict = rabbit2kgbsturct(path)
    frame_dict_data = json.loads(frame_dict_json)
    frame_dict = rearraytoframe(frame_dict_data)
    
    totalresult = {}
    
    for frk in frame_dict.keys():
        frm = frame_dict[frk] 
    
        #frame 별로 반복
        resultf = anabunny(*frm)
        
        totalresult[frk] = copy.deepcopy(resultf)
    
    
    save_revitresult(totalresult, outputFolderName, runtime)
    
    # element force 그리기 
    force_res = {}
    for frk in totalresult.keys(): # frame별
        frm = totalresult[frk]
    
        lt_res = {}
        for lt in frm.keys(): #load type 별
            frmlt = frm[lt]
    
            el_res = {}
            for elk in frmlt['element'].keys(): # element 별
                el_res[elk] = Showelementforce(elk, frmlt['element'], frame_dict[frk][4][lt],0)[elk]
    
            lt_res[lt] = el_res
    
        force_res[frk] = lt_res
    
    
    
    with open(outputFolderName +'/HSD_element_force_json'+runtime+'.txt', 'w') as outfilevar:
        res = json.dump(force_res, outfilevar)
    
    
    
    print('HSD_frame_module run complete')
    print('input : ', filename)
    print(f'result : HSD_element_force_json{runtime}, HSD_element_force_json{runtime}',)
    # os.system("pause")

    return totalresult, force_res

if executionMode == "프레임해석모드":
    res = createResult_frameModule(frame_dict_json, filename, outputFolderName)
else:
    res = 0


#####################################################################

# Assign your output to the OUT variable.
OUT = res
# ----------------------------------------
결과 = Watch(하중분배결과파일_이름_생성)
