# Dynamo graph [HSD kit]_하중분배_[1.0.4].dyn (Dynamo 2.16.1.2727)

rooms_by_status = RoomsByStatus()
coreCenterBoundary = Room.CoreCenterBoundary(room=rooms_by_status.PlacedRooms)
byJoinedCurves = PolyCurve.ByJoinedCurves(curves=coreCenterBoundary)
categories = Categories("OST_StructuralFraming")
all_elements_of_category = ElementsOfCategory(Category=categories)
code_block = CodeBlock { "Reference Level"; }
getParameterValueByName = Element.GetParameterValueByName(element=all_elements_of_category, parameterName=code_block)
parameters = Element.Parameters(element=rooms_by_status.PlacedRooms)
categories_2 = Categories("OST_StructuralColumns")
all_elements_of_category_2 = ElementsOfCategory(Category=categories_2)
제외단면 = StringInput("""W200xL200,
W300xL300""")

# group: 제외 단면 명 리스트 정리구간
code_block_2 = CodeBlock { ","; }
split = String.Split(string=제외단면, separator0=code_block_2)
code_block_3 = CodeBlock { "\n"; }
split_2 = String.Split(string=split, separator0=code_block_3)
flatten = List.Flatten(list=split_2)

filterAGCols = Python(IN[0]=all_elements_of_category_2, IN[1]=flatten)  # CPython3
# ---------- filterAGCols.python (59 lines) ----------
# Load the Python Standard and DesignScript Libraries
import sys
import clr
clr.AddReference('ProtoGeometry')
from Autodesk.DesignScript.Geometry import *

#################################Module For Functional Programing#############################################
from functools import reduce
curry = lambda f: lambda a,*args: f(a, *args) if (len(args)) else lambda *args: f(a, *args)

filter = curry(filter)
map = curry(map)

def _take(length, iter):
    res = []
    for a in iter:
        res.append(a)
        if len(res) == length:
            return res
        
take = curry(_take)
reduce = curry(reduce)

go = lambda *args: reduce(lambda a,f: f(a), args) ## 함수도 축약 가능 ##
##############################################################################################################

# The inputs to this node will be stored as a list in the IN variables.
dataEnteringNode = IN
cols = IN[0]
exceptionRules = IN[1]
# Place your code below this line

#def getColumnCrv(els,exceptionRule):
#    res = go\
#    (
#        els,
#        filter(lambda x: "UG PED" not in str(x.GetParameterValueByName("Family and Type"))),
#        filter(lambda x: exceptionRule not in str(x.GetParameterValueByName("Family and Type"))),
#    )
#    
#    return res

def getColumnCrv_(els,exceptionRules):
    defaultFiltering = go\
    (
        els,
        filter(lambda x: "UG PED" not in str(x.GetParameterValueByName("Family and Type"))),
        list,
    )
    
    res = defaultFiltering
    for r in exceptionRules:
        res = list(filter(lambda x: r not in str(x.GetParameterValueByName("Family and Type")), res))
    
    
    return res

# Assign your output to the OUT variable.
OUT = getColumnCrv_(cols,exceptionRules)
# ----------------------------------------
getColumnCrv = Python(IN[0]=filterAGCols)  # CPython3; frozen
# ---------- getColumnCrv.python (43 lines) ----------
# Load the Python Standard and DesignScript Libraries
import sys
import clr
clr.AddReference('ProtoGeometry')
from Autodesk.DesignScript.Geometry import *

#################################Module For Functional Programing#############################################
from functools import reduce
curry = lambda f: lambda a,*args: f(a, *args) if (len(args)) else lambda *args: f(a, *args)

filter = curry(filter)
map = curry(map)

def _take(length, iter):
    res = []
    for a in iter:
        res.append(a)
        if len(res) == length:
            return res
        
take = curry(_take)
reduce = curry(reduce)

go = lambda *args: reduce(lambda a,f: f(a), args) ## 함수도 축약 가능 ##
##############################################################################################################

# The inputs to this node will be stored as a list in the IN variables.
dataEnteringNode = IN
cols = IN[0]
# Place your code below this line

def getColumnCrv(el):
    sttPt = el.GetLocation()
    endPt = go\
    (
        el,
        lambda x: x.GetLocation(),
        lambda x: x.Translate(0,0, el.GetParameterValueByName("Length")),
    )
    
    return Line.ByStartPointEndPoint(sttPt,endPt)
# Assign your output to the OUT variable.
OUT = map(getColumnCrv,cols)
# ----------------------------------------
code_block_4 = CodeBlock { "Reference Level Elevation"; }
getParameterValueByName_2 = Element.GetParameterValueByName(element=all_elements_of_category, parameterName=code_block_4)
groupByKey = List.GroupByKey(list=all_elements_of_category, keys=getParameterValueByName_2)
code_block_5 = CodeBlock(i=groupByKey.groups) { i[2]; }
flatten_2 = List.Flatten(list=code_block_5)

# group: 빔 위치 커브 X, Y 축 분개
getLocation = Element.GetLocation(element=flatten_2)
direction = Line.Direction(line=getLocation)
normalized = Vector.Normalized(vector=direction)
getXYZ = Python(IN[0]=normalized)  # CPython3
# ---------- getXYZ.python (42 lines) ----------
# Load the Python Standard and DesignScript Libraries
import sys
import clr
clr.AddReference('ProtoGeometry')
from Autodesk.DesignScript.Geometry import *

#################################Module For Functional Programing#############################################
from functools import reduce
curry = lambda f: lambda a,*args: f(a, *args) if (len(args)) else lambda *args: f(a, *args)

filter = curry(filter)
map = curry(map)

def _take(length, iter):
    res = []
    for a in iter:
        res.append(a)
        if len(res) == length:
            return res
        
take = curry(_take)
reduce = curry(reduce)

go = lambda *args: reduce(lambda a,f: f(a), args) ## 함수도 축약 가능 ##
##############################################################################################################

# The inputs to this node will be stored as a list in the IN variables.
dataEnteringNode = IN
vecs = IN[0]
# Place your code below this line

def getXYZ(vecs):
    res = go\
    (
        vecs,
        map(lambda x: (round(x.X), round(x.Y), round(x.Z))),
        map(str),
    )
    
    return res
# Assign your output to the OUT variable.
OUT = getXYZ(vecs)
# ----------------------------------------
firstItem = List.FirstItem(list=normalized)
isParallel = Vector.IsParallel(vector=firstItem, otherVector=normalized)
groupByKey_2 = List.GroupByKey(list=getLocation, keys=isParallel)

code_block_6 = CodeBlock(i=groupByKey.groups) { i[1]; }
name = Element.Name(element=code_block_6)
code_block_7 = CodeBlock { "G"; }
contains = String.Contains(string=name, searchFor=code_block_7)
filterByBoolMask = List.FilterByBoolMask(list=code_block_6, mask=contains)
frame_사이_일괄_면_생성_new = Python(IN[1]=groupByKey_2.groups)  # CPython3; unwired: IN[0]
# ---------- frame_사이_일괄_면_생성_new.python (155 lines) ----------
# Load the Python Standard and DesignScript Libraries
import sys
import clr
clr.AddReference('ProtoGeometry')
from Autodesk.DesignScript.Geometry import *
from Autodesk.DesignScript.Geometry import Line

from math import sqrt, hypot
from itertools import combinations
################Module For Functional Programing#########################
from functools import reduce; from itertools import chain
from itertools import groupby; import operator
from copy import deepcopy
curry = lambda f: lambda a,*args: f(a, *args) if (len(args)) else lambda *args: f(a, *args)

filter, map, reduce = curry(filter), curry(map), curry(reduce)

go = lambda *args: reduce(lambda a,f: f(a), args) ## 함수도 축약 가능 ##

def dictUpdate(dic1,dic2):
    dic1.update(dic2)
    return dic1
    
def dictsMerge(dics):
    res = reduce(dictUpdate, dics)
    return res
    
def dictDeleteKeys(dic, keys):
    for k in keys:
        del dic[k]
    return dic

def flat(a):
    if isinstance(a, list):
        for i in a: 
            yield from flat(i)
    else: yield a

def grpBy(iter, key):
    f,keys,grps = key,[],[]
    sorted_ = sorted(iter, key=f)
    for key, grp_data in groupby(sorted_,key=f):
        keys.append(key); grps.append(list(grp_data))
    return grps,keys
#########################################################################

def concave_hull_(points, alpha):
    points = UnwrapElement(points)
    res = []
    
    pLen = len(points)
    alpha2 = alpha * alpha
    if pLen < 2:
        raise Exception('AlphaShape needs at least 2 points')

    for i, p in enumerate(points):
        for j in range(i+1, pLen):
            if p.IsAlmostEqualTo(points[j]):
                raise Exception('AlphaShape needs pairwise distinct points')
            dist = hypot(p.X - points[j].X, p.Y - points[j].Y)                    
            #if (dist > 2 * alpha) : continue #circle fits between points ==> p_i, p_j can't be alpha-exposed                    
    
            x1, y1, x2, y2 = p.X, p.Y, points[j].X, points[j].Y
            midX, midY = (x1 + x2) / 2, (y1 + y2) / 2
    
            #find two circles that contain p_i and p_j; note that center1 == center2 if dist == 2*alpha
            alphaDist = sqrt(alpha2 - (dist / 2) ** 2)
            #alphaDist = alpha2 - (dist / 2) ** 2
            deltaX, deltaY = (x2 - x1) / dist, (y1 - y2) / dist
            c1x, c1y = midX + alphaDist * deltaY, midY + alphaDist * deltaX
            c2x, c2y = midX - alphaDist * deltaY, midY - alphaDist * deltaX
            
            #check if one of the circles is alpha-exposed, i.e. no other point lies in it
            c1_empty = True 
            c2_empty = True
            for k in range(pLen):                
                if i == k or j == k: 
                    continue
                if ((c1x - points[k].X) * (c1x - points[k].X) + (c1y - points[k].Y) * (c1y - points[k].Y) < alpha2):
                    c1_empty = False
                if ((c2x - points[k].X) * (c2x - points[k].X) + (c2y - points[k].Y) * (c2y - points[k].Y) < alpha2):
                    c2_empty = False
                if not c1_empty and not c2_empty:
                    break
            if c1_empty or c2_empty:
                res.append(Line.ByStartPointEndPoint(p, points[j]))
                #res.append(c1_empty)
    return res
    
# The inputs to this node will be stored as a list in the IN variables.
dataEnteringNode = IN
#concaveHullfunc = IN[0]
grids = IN[1]
gridsX, gridsY = grids

# Place your code below this line


dataX = go(
    gridsX,
    lambda x: sorted(x, key=lambda e: e.StartPoint.X),
    lambda x: grpBy(x, key=lambda e: e.StartPoint.X)[0],
    map(lambda x: sorted(x, key=lambda e: e.StartPoint.Y)),
    #2개씩 1간격으로 서브리스트 생성
    map(lambda x: list(map(lambda n: x[n:n+1+1], range(len(x))[:-1]))),
    lambda x: list(chain(*x)),
)
dataY = go(
    gridsY,
    lambda x: sorted(x, key=lambda e: e.StartPoint.X),
    lambda x: grpBy(x, key=lambda e: e.StartPoint.X)[0],
    map(lambda x: sorted(x, key=lambda e: e.StartPoint.Y)),list,
    #2개씩 1간격으로 서브리스트 생성
    lambda x: list(map(lambda n: x[n:n+1+1], range(len(x))[:-1])),
    # 서브리스트 구조 Transpose
    map(lambda x: list(zip(*chain(x)))),
    lambda x: list(chain(*x)),
)

def get_IntersectInGrp(xGrp, yGrp):
    res = []
    for x in xGrp:
        for y in yGrp:
            res.append(x.Intersect(y))
    return list(chain(*res))

def GetBoundingSrfs(intscts):
    res = []
    try:
        crvSet = concave_hull_(intscts, 100000)
        polyCrv = PolyCurve.ByJoinedCurves(crvSet)
        srf = Surface.ByPatch(polyCrv)
        srfThick = srf.Thicken(10,False)
        bdCube = BoundingBox.ByGeometry(srfThick).ToCuboid()
        bdCubeSrfs = bdCube.Explode()
        bdBelowSrf = go(
            bdCubeSrfs,
            filter(lambda x: x.NormalAtParameter(0.5,0.5).Z == -1),
            list
        )[0]
        return bdBelowSrf
    except: pass
    
    
def main(xGrps, yGrps):
    res = []
    for xGrp in xGrps:
        for yGrp in yGrps:
            intscts = get_IntersectInGrp(xGrp, yGrp)
            if GetBoundingSrfs(intscts):
                res.append(GetBoundingSrfs(intscts))
    return res
    
# Assign your output to the OUT variable.
OUT = main(dataX, dataY)
# ----------------------------------------
integer_slider = IntegerSlider(14, range=0..16 step 1)
code_block_8 = CodeBlock(i=frame_사이_일괄_면_생성_new, j=integer_slider) { i[j]; }
color_palette = ColorPalette({R: 255, G: 105, B: 180, A: 255})
byGeometryColor = Modifiers.GeometryColor.ByGeometryColor(geometry=code_block_8, color=color_palette)
color_palette_2 = ColorPalette({R: 170, G: 193, B: 233, A: 154})
byGeometryColor_2 = Modifiers.GeometryColor.ByGeometryColor(geometry=frame_사이_일괄_면_생성_new, color=color_palette_2)

# group: 면들 꼭지점 추출
code_block_9 = CodeBlock { 0; 1; }
좌상단 = Surface.PointAtParameter(surface=frame_사이_일괄_면_생성_new, u=code_block_9.out0, v=code_block_9.out1)
우상단 = Surface.PointAtParameter(surface=frame_사이_일괄_면_생성_new, u=code_block_9.out1, v=code_block_9.out1)
좌하단 = Surface.PointAtParameter(surface=frame_사이_일괄_면_생성_new, u=code_block_9.out0, v=code_block_9.out0)
우하단 = Surface.PointAtParameter(surface=frame_사이_일괄_면_생성_new, u=code_block_9.out1, v=code_block_9.out0)

code_block_10 = CodeBlock { 0.5; 0; }
pointAtParameter = Surface.PointAtParameter(surface=frame_사이_일괄_면_생성_new, u=code_block_10.out0, v=code_block_10.out1)
code_block_11 = CodeBlock { 0.5; 1; }
pointAtParameter_2 = Surface.PointAtParameter(surface=frame_사이_일괄_면_생성_new, u=code_block_11.out0, v=code_block_11.out1)
byStartPointEndPoint = Line.ByStartPointEndPoint(startPoint=pointAtParameter, endPoint=pointAtParameter_2)

# group: 단변추출
code_block_12 = CodeBlock { 0; 1; }
pointAtParameter_3 = Surface.PointAtParameter(surface=frame_사이_일괄_면_생성_new, u=code_block_12.out0, v=code_block_12.out0)
pointAtParameter_4 = Surface.PointAtParameter(surface=frame_사이_일괄_면_생성_new, u=code_block_12.out1, v=code_block_12.out0)
byStartPointEndPoint_2 = Line.ByStartPointEndPoint(startPoint=pointAtParameter_3, endPoint=pointAtParameter_4)

length = Curve.Length(curve=byStartPointEndPoint_2)
code_block_13 = CodeBlock { 2; }
div = length / code_block_13
byCenterPointRadius = Circle.ByCenterPointRadius(centerPoint=pointAtParameter_2, radius=div)
intersect = Geometry.Intersect(geometry=byStartPointEndPoint, other=byCenterPointRadius)
상단45도점 = List.Flatten(list=intersect)
byStartPointEndPoint_3 = Line.ByStartPointEndPoint(startPoint=좌상단, endPoint=상단45도점)
byStartPointEndPoint_4 = Line.ByStartPointEndPoint(startPoint=우상단, endPoint=상단45도점)
byCenterPointRadius_2 = Circle.ByCenterPointRadius(centerPoint=pointAtParameter, radius=div)
intersect_2 = Geometry.Intersect(geometry=byStartPointEndPoint, other=byCenterPointRadius_2)
하단45도점 = List.Flatten(list=intersect_2)
byStartPointEndPoint_5 = Line.ByStartPointEndPoint(startPoint=좌하단, endPoint=하단45도점)
byStartPointEndPoint_6 = Line.ByStartPointEndPoint(startPoint=우하단, endPoint=하단45도점)

# group: 2way 슬라브경우 내부2등분선
byStartPointEndPoint_7 = Line.ByStartPointEndPoint(startPoint=상단45도점, endPoint=하단45도점)

parameters_2 = Element.Parameters(element=groupByKey.groups)
concave_hull = Python()  # CPython3; unwired: IN[0]
# ---------- concave_hull.python (55 lines) ----------
# Load the Python Standard and DesignScript Libraries
import sys
import clr
clr.AddReference('ProtoGeometry')
from Autodesk.DesignScript.Geometry import *
from math import sqrt, hypot
from itertools import combinations
# The inputs to this node will be stored as a list in the IN variables.
dataEnteringNode = IN

# Place your code below this line
def concave_hull_(points, alpha):
    points = UnwrapElement(points)
    res = []
    
    pLen = len(points)
    alpha2 = alpha * alpha
    if pLen < 2:
        raise Exception('AlphaShape needs at least 2 points')

    for i, p in enumerate(points):
        for j in range(i+1, pLen):
            if p.IsAlmostEqualTo(points[j]):
                raise Exception('AlphaShape needs pairwise distinct points')
            dist = hypot(p.X - points[j].X, p.Y - points[j].Y)                    
            #if (dist > 2 * alpha) : continue #circle fits between points ==> p_i, p_j can't be alpha-exposed                    
    
            x1, y1, x2, y2 = p.X, p.Y, points[j].X, points[j].Y
            midX, midY = (x1 + x2) / 2, (y1 + y2) / 2
    
            #find two circles that contain p_i and p_j; note that center1 == center2 if dist == 2*alpha
            alphaDist = sqrt(alpha2 - (dist / 2) ** 2)
            #alphaDist = alpha2 - (dist / 2) ** 2
            deltaX, deltaY = (x2 - x1) / dist, (y1 - y2) / dist
            c1x, c1y = midX + alphaDist * deltaY, midY + alphaDist * deltaX
            c2x, c2y = midX - alphaDist * deltaY, midY - alphaDist * deltaX
            
            #check if one of the circles is alpha-exposed, i.e. no other point lies in it
            c1_empty = True 
            c2_empty = True
            for k in range(pLen):                
                if i == k or j == k: 
                    continue
                if ((c1x - points[k].X) * (c1x - points[k].X) + (c1y - points[k].Y) * (c1y - points[k].Y) < alpha2):
                    c1_empty = False
                if ((c2x - points[k].X) * (c2x - points[k].X) + (c2y - points[k].Y) * (c2y - points[k].Y) < alpha2):
                    c2_empty = False
                if not c1_empty and not c2_empty:
                    break
            if c1_empty or c2_empty:
                res.append(Line.ByStartPointEndPoint(p, points[j]))
                #res.append(c1_empty)
    return res
# Assign your output to the OUT variable.
OUT = concave_hull_
# ----------------------------------------
n1_dl_층별_정보_kn_m² = StringInput("""34.05
15.05
4.1
0.35""")  # "1. DL 층별 정보(kN/m²)"; graph input
code_block_14 = CodeBlock { " "; "\n"; }
split_3 = String.Split(string=n1_dl_층별_정보_kn_m², separator0=code_block_14.out0, separator1=code_block_14.out1)
toNumber = String.ToNumber(string=split_3)
code_block_15 = CodeBlock(i=toNumber) { i; }
전층_경간_면_생성 = Python(IN[0]=concave_hull, IN[1]=code_block_15, IN[2]=groupByKey.groups)  # CPython3
# ---------- 전층_경간_면_생성.python (144 lines) ----------
# Load the Python Standard and DesignScript Libraries
import sys
import clr
clr.AddReference('ProtoGeometry')
from Autodesk.DesignScript.Geometry import *
from Autodesk.DesignScript.Geometry import Line

from math import sqrt, hypot
from itertools import combinations
################Module For Functional Programing#########################
from functools import reduce; from itertools import chain
from itertools import groupby; import operator
from copy import deepcopy
curry = lambda f: lambda a,*args: f(a, *args) if (len(args)) else lambda *args: f(a, *args)

filter, map, reduce = curry(filter), curry(map), curry(reduce)

go = lambda *args: reduce(lambda a,f: f(a), args) ## 함수도 축약 가능 ##

def dictUpdate(dic1,dic2):
    dic1.update(dic2)
    return dic1
    
def dictsMerge(dics):
    res = reduce(dictUpdate, dics)
    return res
    
def dictDeleteKeys(dic, keys):
    for k in keys:
        del dic[k]
    return dic

def flat(a):
    if isinstance(a, list):
        for i in a: 
            yield from flat(i)
    else: yield a

def grpBy(iter, key):
    f,keys,grps = key,[],[]
    sorted_ = sorted(iter, key=f)
    for key, grp_data in groupby(sorted_,key=f):
        keys.append(key); grps.append(list(grp_data))
    return grps,keys
#########################################################################
    
# The inputs to this node will be stored as a list in the IN variables.
dataEnteringNode = IN
concave_hull = IN[0]
loadPerLevel = IN[1]
elems_forAllLv = IN[2]
#gridsX, gridsY = grids

# Place your code below this line


def grp_XYbeamsPerLv(elemsPerLv):
    allLines = go(
        elemsPerLv,
        map(lambda x: x.GetLocation()),
        list,
    )
    directionsPerLevel = go(
        allLines,
        map(lambda x: x.Direction),
        map(lambda x: x.Normalized()),
        list,
    )
    
    isParallel = lambda e: go(
        e,
        lambda x: x.Direction,
        lambda x: x.Normalized(),
        lambda x: not x.IsParallel(directionsPerLevel[0]),
    )
    
    
    return grpBy(allLines, isParallel)[0]

def make_pairFrames(xGrps, yGrps):
    pairX = go(
        xGrps,
        lambda x: sorted(x, key=lambda e: e.StartPoint.X),
        lambda x: grpBy(x, key=lambda e: e.StartPoint.X)[0],
        map(lambda x: sorted(x, key=lambda e: e.StartPoint.Y)),
        #2개씩 1간격으로 서브리스트 생성
        map(lambda x: list(map(lambda n: x[n:n+1+1], range(len(x))[:-1]))),
        lambda x: list(chain(*x)),
    )
    pairY = go(
        yGrps,
        lambda x: sorted(x, key=lambda e: e.StartPoint.X),
        lambda x: grpBy(x, key=lambda e: e.StartPoint.X)[0],
        map(lambda x: sorted(x, key=lambda e: e.StartPoint.Y)),list,
        #2개씩 1간격으로 서브리스트 생성
        lambda x: list(map(lambda n: x[n:n+1+1], range(len(x))[:-1])),
        # 서브리스트 구조 Transpose
        map(lambda x: list(zip(*chain(x)))),
        lambda x: list(chain(*x)),
    )
    return pairX, pairY

def get_IntersectInGrp(xGrp, yGrp):
    res = []
    for x in xGrp:
        for y in yGrp:
            res.append(x.Intersect(y))
    return list(chain(*res))

def GetBoundingSrfs(intscts):
    res = []
    try:
        crvSet = concave_hull(intscts, 100000)
        polyCrv = PolyCurve.ByJoinedCurves(crvSet)
        srf = Surface.ByPatch(polyCrv)
        srfThick = srf.Thicken(10,False)
#        bdCube = BoundingBox.ByGeometry(srfThick).ToCuboid()
#        bdCubeSrfs = bdCube.Explode()
#        bdBelowSrf = go(
#            bdCube.Explode(),
#            #bdCubeSrfs,
#            filter(lambda x: x.NormalAtParameter(0.5,0.5).Z != 0),
#            list,
#        )[0]
        return srf
    except: pass

def makeSrf_btwnFrame(xGrps, yGrps):
    res = []
    for xGrp in xGrps:
        for yGrp in yGrps:
            intscts = get_IntersectInGrp(xGrp, yGrp)
            if GetBoundingSrfs(intscts):
                res.append(GetBoundingSrfs(intscts))

    return res


# Assign your output to the OUT variable.
XY_elems_forAllLv = list(map(grp_XYbeamsPerLv, elems_forAllLv))
pairFrames_forAllLv = list(map(lambda x: list(make_pairFrames(*x)), XY_elems_forAllLv))
srfs_forAllLv = list(map(lambda x: list(makeSrf_btwnFrame(*x)), pairFrames_forAllLv))

OUT = srfs_forAllLv
# ----------------------------------------
전층_경간면_내부_등분선_찾기 = Python(IN[0]=concave_hull, IN[1]=전층_경간_면_생성)  # CPython3
# ---------- 전층_경간면_내부_등분선_찾기.python (107 lines) ----------
# Load the Python Standard and DesignScript Libraries
import sys
import clr
clr.AddReference('ProtoGeometry')
from Autodesk.DesignScript.Geometry import *

################Module For Functional Programing#########################
from functools import reduce; from itertools import chain
from itertools import groupby; import operator
from copy import deepcopy
curry = lambda f: lambda a,*args: f(a, *args) if (len(args)) else lambda *args: f(a, *args)

filter, map, reduce = curry(filter), curry(map), curry(reduce)

go = lambda *args: reduce(lambda a,f: f(a), args) ## 함수도 축약 가능 ##

def dictUpdate(dic1,dic2):
    dic1.update(dic2)
    return dic1
    
def dictsMerge(dics):
    res = reduce(dictUpdate, dics)
    return res
    
def dictDeleteKeys(dic, keys):
    for k in keys:
        del dic[k]
    return dic

def flat(a):
    if isinstance(a, list):
        for i in a: 
            yield from flat(i)
    else: yield a

def grpBy(iter, key):
    f,keys,grps = key,[],[]
    sorted_ = sorted(iter, key=f)
    for key, grp_data in groupby(sorted_,key=f):
        keys.append(key); grps.append(list(grp_data))
    return grps,keys
#########################################################################


# The inputs to this node will be stored as a list in the IN variables.
dataEnteringNode = IN
concave_hull = IN[0]
srfs_forAllLv = IN[1]
# Place your code below this line

def find_allCorner(srf):
    u_stt = srf.PointAtParameter(0,1)
    u_end = srf.PointAtParameter(1,1)
    b_stt = srf.PointAtParameter(0,0)
    b_end = srf.PointAtParameter(1,0)
    
    return u_stt, u_end, b_stt, b_end

def find_shortSide(srf):
    u_stt, u_end, b_stt, b_end = find_allCorner(srf)
    u_shortSide = Line.ByStartPointEndPoint(u_stt, u_end)
    b_shortSide = Line.ByStartPointEndPoint(b_stt, b_end)
    
    return u_shortSide, b_shortSide

def find_longSide_midLine(srf):
    u_shortSide, b_shortSide = find_shortSide(srf)
    u_midPt = u_shortSide.PointAtParameter(0.5)
    b_midPt = b_shortSide.PointAtParameter(0.5)
    midLine = Line.ByStartPointEndPoint(u_midPt, b_midPt)
    
    return midLine

def find_2wayRefPts(srf):
    u_shortSide, b_shortSide = find_shortSide(srf)
    shortSideLength = u_shortSide.Length
    u_midPt = u_shortSide.PointAtParameter(0.5)
    b_midPt = b_shortSide.PointAtParameter(0.5)
    midLine = find_longSide_midLine(srf)
    midLineVec = midLine.Direction
    tgt_plane = Plane.ByThreePoints(u_midPt,find_allCorner(srf)[2],find_allCorner(srf)[3])
    srfNormalVec = srf.NormalAtParameter(0.5,0.5)
    u_circle = Circle.ByCenterPointRadiusNormal(u_midPt, shortSideLength/2, srfNormalVec)
    b_circle = Circle.ByCenterPointRadiusNormal(b_midPt, shortSideLength/2, srfNormalVec)
    u_45d_pt = midLine.Intersect(u_circle)[0]
    b_45d_pt = midLine.Intersect(b_circle)[0]
    
    return u_45d_pt, b_45d_pt

def div_srf_2way(srf):
    u_stt, u_end, b_stt, b_end = find_allCorner(srf)
    u_45d_pt, b_45d_pt = find_2wayRefPts(srf)
    
    l_srf = concave_hull([u_stt,b_stt,u_45d_pt, b_45d_pt], 100000)
    r_srf = concave_hull([u_end,b_end,u_45d_pt, b_45d_pt], 100000)
    u_srf = concave_hull([u_stt,u_end, u_45d_pt], 100000)
    b_srf = concave_hull([b_stt,b_end, b_45d_pt], 100000)
    
    return l_srf, r_srf, u_srf, b_srf

def div_srf(srf, mode="1way"):
    
    
    pass

# Assign your output to the OUT variable.
OUT = map(div_srf_2way, srfs_forAllLv[2])
# ----------------------------------------
code_block_16 = CodeBlock()
# ---------- code_block_16.designscript (4 lines) ----------
// 1. case
// DL = 부재자중(메인부재 + 그레이팅 하중) + 유관부서 EL
// 2. case < -우선 구현
// DL = 각 층의 Floor 로드를 정해서 입력하는 방식
# ----------------------------------------
n2_ll_층별_정보_kn_m² = StringInput("""7.5
10
15
1""")  # "2. LL 층별 정보(kN/m²)"; graph input
n3_a_wind_code_선택 = CustomSelection("ASCE-7", items={ASCE-7: "ASCE-7", KDS 41 12 00: "KDS 41 12 00", EN 1991-1-1-4: "EN 1991-1-1-4"})  # "3. a :: Wind_Code 선택"; graph input
n3_c_wind_enclosure = CustomSelection("BD-Enclosed", items={BD-Enclosed: "BD-Enclosed", BD-Partially Enclosed: "BD-Partially Enclosed", BD-Open: "BD-Open", Shelter: "Shelter"})  # "3. c :: Wind_Enclosure Classification"; graph input
n3_b_wind_information_입력_대괄호_항목 = StringInput("""[Basic_Wind_Speed]:
» 33.34

[Exposur_Category]
» C

[Topographic_factor(Kzt)]
» 1.0""")  # "3. b :: Wind Information 입력 (대괄호 항목 다음줄에 입력)"; graph input
code_block_17 = CodeBlock { ":"; " "; "\n"; }
split_4 = String.Split(string=n3_b_wind_information_입력_대괄호_항목, separator0=code_block_17.out0, separator1=code_block_17.out1, separator2=code_block_17.out2)
input_제어기 = Python(IN[0]=split_4)  # CPython3
# ---------- input_제어기.python (28 lines) ----------
# Load the Python Standard and DesignScript Libraries
import sys
import clr
clr.AddReference('ProtoGeometry')
from Autodesk.DesignScript.Geometry import *

# The inputs to this node will be stored as a list in the IN variables.
dataEnteringNode = IN
inputStrs = IN[0]
# Place your code below this line
def strToint(i):
    try:
        res = float(i)
    except:
        res = i
    return res
inputDatas = map(strToint, inputStrs)

def dictInput(inputStrs):
    if inputStrs[0].startswith("["):
        inputPairs = list(map(lambda n: inputStrs[n:n+1+1], range(0,len(inputStrs),2)))
        res = dict(inputPairs)
    else:
        res = 0
    return res
    
# Assign your output to the OUT variable.
OUT = inputDatas
# ----------------------------------------
n0_실행모드 = CustomSelection("해석모드", items={입력모드: "입력모드", 해석모드: "해석모드"})  # "0. 실행모드"; graph input
code_block_18 = CodeBlock { ".dynTemp"; }
filePath = Python(IN[0]=code_block_18)  # CPython3
# ---------- filePath.python (34 lines) ----------
# Load the Python Standard and DesignScript Libraries
import sys
import clr
clr.AddReference('ProtoGeometry')
from Autodesk.DesignScript.Geometry import *
import time
import subprocess
import os

clr.AddReference('RevitNodes')
import Revit
clr.ImportExtensions(Revit.Elements)
from Revit import Elements
# The inputs to this node will be stored as a list in the IN variables.
dataEnteringNode = IN
dynTempServerPath = IN[0]
# Place your code below this line
def find_cwd():
    doc = Revit.Application.Document.Current
    filePath_string = doc.FilePath
    folderPath = filePath_string.split('\\')
    folderPath.pop(-1)
    folderPath_str = '\\'.join(folderPath)
    return folderPath_str

#cwd = find_cwd()
cwd = os.getenv("HomePath")

folderPath = f"{cwd}\\{dynTempServerPath}"
if not os.path.exists(folderPath):
    os.makedirs(folderPath)

# Assign your output to the OUT variable.
OUT = "C:"+folderPath
# ----------------------------------------
n4_a_seismic_code_선택 = CustomSelection("ASCE-7", items={ASCE-7: "ASCE-7", KDS 41 12 00: "KDS 41 12 00", EN 1991-1-1-4: "EN 1991-1-1-4"})  # "4. a :: Seismic_Code 선택"; graph input
n4_b_seismic_information_입력_대괄호 = StringInput("""[Site_Class]:
» 33.34

[Risk_Category]
» C

[Response_modification_factor_X]
» 3.0
[Response_modification_factor_Y]
» 3.0

[Spectral_acceleration_parameters_Sds]
» 0.091

[Spectral_acceleration_parameters_Sd1]
» 0.087""")  # "4. b :: Seismic Information 입력 (대괄호 항목 다음줄에 입력)"; graph input
angleWithVector = Vector.AngleWithVector()  # unwired: vector, otherVector
