# Dynamo graph [HSD kit]_하중분배_[1.0.5].dyn (Dynamo 2.16.1.2727)

# note: 소속 입면 정보도 딕셔너리 추가
# 외부기둥만(판별은 기둥 로케이션 라인 전체 바운딩 박스로)
# 내부기둥은 정보 없음으로
# Nside
# Eside
# Sside
# Wside

rooms_by_status = RoomsByStatus()
coreCenterBoundary = Room.CoreCenterBoundary(room=rooms_by_status.PlacedRooms)
byJoinedCurves = PolyCurve.ByJoinedCurves(curves=coreCenterBoundary)
categories = Categories("OST_StructuralFraming")
all_elements_of_category = ElementsOfCategory(Category=categories)
code_block = CodeBlock { "Reference Level"; }
getParameterValueByName = Element.GetParameterValueByName(element=all_elements_of_category, parameterName=code_block)
parameters = Element.Parameters(element=rooms_by_status.PlacedRooms)
categories_2 = Categories("OST_StructuralColumns")
all_elements_of_category_2 = ElementsOfCategory(Category=categories_2)
제외단면 = StringInput("""W200xL200,
W300xL300""")

# group: 제외 단면 명 리스트 정리구간
code_block_2 = CodeBlock { ","; }
split = String.Split(string=제외단면, separator0=code_block_2)
code_block_3 = CodeBlock { "\n"; }
split_2 = String.Split(string=split, separator0=code_block_3)
flatten = List.Flatten(list=split_2)

filterAGCols = Python(IN[0]=all_elements_of_category_2, IN[1]=flatten)  # CPython3
# ---------- filterAGCols.python (59 lines) ----------
# Load the Python Standard and DesignScript Libraries
import sys
import clr
clr.AddReference('ProtoGeometry')
from Autodesk.DesignScript.Geometry import *

#################################Module For Functional Programing#############################################
from functools import reduce
curry = lambda f: lambda a,*args: f(a, *args) if (len(args)) else lambda *args: f(a, *args)

filter = curry(filter)
map = curry(map)

def _take(length, iter):
    res = []
    for a in iter:
        res.append(a)
        if len(res) == length:
            return res
        
take = curry(_take)
reduce = curry(reduce)

go = lambda *args: reduce(lambda a,f: f(a), args) ## 함수도 축약 가능 ##
##############################################################################################################

# The inputs to this node will be stored as a list in the IN variables.
dataEnteringNode = IN
cols = IN[0]
exceptionRules = IN[1]
# Place your code below this line

#def getColumnCrv(els,exceptionRule):
#    res = go\
#    (
#        els,
#        filter(lambda x: "UG PED" not in str(x.GetParameterValueByName("Family and Type"))),
#        filter(lambda x: exceptionRule not in str(x.GetParameterValueByName("Family and Type"))),
#    )
#    
#    return res

def getColumnCrv_(els,exceptionRules):
    defaultFiltering = go\
    (
        els,
        filter(lambda x: "UG PED" not in str(x.GetParameterValueByName("Family and Type"))),
        list,
    )
    
    res = defaultFiltering
    for r in exceptionRules:
        res = list(filter(lambda x: r not in str(x.GetParameterValueByName("Family and Type")), res))
    
    
    return res

# Assign your output to the OUT variable.
OUT = getColumnCrv_(cols,exceptionRules)
# ----------------------------------------
getColumnCrv = Python(IN[0]=filterAGCols)  # CPython3; frozen
# ---------- getColumnCrv.python (43 lines) ----------
# Load the Python Standard and DesignScript Libraries
import sys
import clr
clr.AddReference('ProtoGeometry')
from Autodesk.DesignScript.Geometry import *

#################################Module For Functional Programing#############################################
from functools import reduce
curry = lambda f: lambda a,*args: f(a, *args) if (len(args)) else lambda *args: f(a, *args)

filter = curry(filter)
map = curry(map)

def _take(length, iter):
    res = []
    for a in iter:
        res.append(a)
        if len(res) == length:
            return res
        
take = curry(_take)
reduce = curry(reduce)

go = lambda *args: reduce(lambda a,f: f(a), args) ## 함수도 축약 가능 ##
##############################################################################################################

# The inputs to this node will be stored as a list in the IN variables.
dataEnteringNode = IN
cols = IN[0]
# Place your code below this line

def getColumnCrv(el):
    sttPt = el.GetLocation()
    endPt = go\
    (
        el,
        lambda x: x.GetLocation(),
        lambda x: x.Translate(0,0, el.GetParameterValueByName("Length")),
    )
    
    return Line.ByStartPointEndPoint(sttPt,endPt)
# Assign your output to the OUT variable.
OUT = map(getColumnCrv,cols)
# ----------------------------------------
code_block_4 = CodeBlock()
# ---------- code_block_4.designscript (4 lines) ----------
// 1. case
// DL = 부재자중(메인부재 + 그레이팅 하중) + 유관부서 EL
// 2. case < -우선 구현
// DL = 각 층의 Floor 로드를 정해서 입력하는 방식
# ----------------------------------------
n2_ll_층별_정보_kn_m² = StringInput("""7.5
10
15
1""")  # "2. LL 층별 정보(kN/m²)"; graph input
n3_a_wind_code_선택 = CustomSelection("ASCE-7", items={ASCE-7: "ASCE-7", KDS 41 12 00: "KDS 41 12 00", EN 1991-1-1-4: "EN 1991-1-1-4"})  # "3. a :: Wind_Code 선택"; graph input
n3_c_wind_enclosure = CustomSelection("BD-Enclosed", items={BD-Enclosed: "BD-Enclosed", BD-Partially Enclosed: "BD-Partially Enclosed", BD-Open: "BD-Open", Shelter: "Shelter"})  # "3. c :: Wind_Enclosure Classification"; graph input
n3_b_wind_information_입력_대괄호_항목 = StringInput("""[Basic_Wind_Speed]:
» 33.34

[Exposur_Category]
» C

[Topographic_factor(Kzt)]
» 1.0""")  # "3. b :: Wind Information 입력 (대괄호 항목 다음줄에 입력)"; graph input
code_block_5 = CodeBlock { ":"; " "; "\n"; }
split_3 = String.Split(string=n3_b_wind_information_입력_대괄호_항목, separator0=code_block_5.out0, separator1=code_block_5.out1, separator2=code_block_5.out2)
input_제어기 = Python(IN[0]=split_3)  # CPython3
# ---------- input_제어기.python (28 lines) ----------
# Load the Python Standard and DesignScript Libraries
import sys
import clr
clr.AddReference('ProtoGeometry')
from Autodesk.DesignScript.Geometry import *

# The inputs to this node will be stored as a list in the IN variables.
dataEnteringNode = IN
inputStrs = IN[0]
# Place your code below this line
def strToint(i):
    try:
        res = float(i)
    except:
        res = i
    return res
inputDatas = map(strToint, inputStrs)

def dictInput(inputStrs):
    if inputStrs[0].startswith("["):
        inputPairs = list(map(lambda n: inputStrs[n:n+1+1], range(0,len(inputStrs),2)))
        res = dict(inputPairs)
    else:
        res = 0
    return res
    
# Assign your output to the OUT variable.
OUT = inputDatas
# ----------------------------------------
n0_실행모드 = CustomSelection("해석모드", items={입력모드: "입력모드", 해석모드: "해석모드"})  # "0. 실행모드"; graph input
code_block_6 = CodeBlock { ".dynTemp"; }
filePath = Python(IN[0]=code_block_6)  # CPython3
# ---------- filePath.python (34 lines) ----------
# Load the Python Standard and DesignScript Libraries
import sys
import clr
clr.AddReference('ProtoGeometry')
from Autodesk.DesignScript.Geometry import *
import time
import subprocess
import os

clr.AddReference('RevitNodes')
import Revit
clr.ImportExtensions(Revit.Elements)
from Revit import Elements
# The inputs to this node will be stored as a list in the IN variables.
dataEnteringNode = IN
dynTempServerPath = IN[0]
# Place your code below this line
def find_cwd():
    doc = Revit.Application.Document.Current
    filePath_string = doc.FilePath
    folderPath = filePath_string.split('\\')
    folderPath.pop(-1)
    folderPath_str = '\\'.join(folderPath)
    return folderPath_str

#cwd = find_cwd()
cwd = os.getenv("HomePath")

folderPath = f"{cwd}\\{dynTempServerPath}"
if not os.path.exists(folderPath):
    os.makedirs(folderPath)

# Assign your output to the OUT variable.
OUT = "C:"+folderPath
# ----------------------------------------
n4_a_seismic_code_선택 = CustomSelection("ASCE-7", items={ASCE-7: "ASCE-7", KDS 41 12 00: "KDS 41 12 00", EN 1991-1-1-4: "EN 1991-1-1-4"})  # "4. a :: Seismic_Code 선택"; graph input
n4_b_seismic_information_입력_대괄호 = StringInput("""[Site_Class]:
» 33.34

[Risk_Category]
» C

[Response_modification_factor_X]
» 3.0
[Response_modification_factor_Y]
» 3.0

[Spectral_acceleration_parameters_Sds]
» 0.091

[Spectral_acceleration_parameters_Sd1]
» 0.087""")  # "4. b :: Seismic Information 입력 (대괄호 항목 다음줄에 입력)"; graph input
concave_hull = Python()  # CPython3; unwired: IN[0]
# ---------- concave_hull.python (55 lines) ----------
# Load the Python Standard and DesignScript Libraries
import sys
import clr
clr.AddReference('ProtoGeometry')
from Autodesk.DesignScript.Geometry import *
from math import sqrt, hypot
from itertools import combinations
# The inputs to this node will be stored as a list in the IN variables.
dataEnteringNode = IN

# Place your code below this line
def concave_hull_(points, alpha):
    points = UnwrapElement(points)
    res = []
    
    pLen = len(points)
    alpha2 = alpha * alpha
    if pLen < 2:
        raise Exception('AlphaShape needs at least 2 points')

    for i, p in enumerate(points):
        for j in range(i+1, pLen):
            if p.IsAlmostEqualTo(points[j]):
                raise Exception('AlphaShape needs pairwise distinct points')
            dist = hypot(p.X - points[j].X, p.Y - points[j].Y)                    
            #if (dist > 2 * alpha) : continue #circle fits between points ==> p_i, p_j can't be alpha-exposed                    
    
            x1, y1, x2, y2 = p.X, p.Y, points[j].X, points[j].Y
            midX, midY = (x1 + x2) / 2, (y1 + y2) / 2
    
            #find two circles that contain p_i and p_j; note that center1 == center2 if dist == 2*alpha
            alphaDist = sqrt(alpha2 - (dist / 2) ** 2)
            #alphaDist = alpha2 - (dist / 2) ** 2
            deltaX, deltaY = (x2 - x1) / dist, (y1 - y2) / dist
            c1x, c1y = midX + alphaDist * deltaY, midY + alphaDist * deltaX
            c2x, c2y = midX - alphaDist * deltaY, midY - alphaDist * deltaX
            
            #check if one of the circles is alpha-exposed, i.e. no other point lies in it
            c1_empty = True 
            c2_empty = True
            for k in range(pLen):                
                if i == k or j == k: 
                    continue
                if ((c1x - points[k].X) * (c1x - points[k].X) + (c1y - points[k].Y) * (c1y - points[k].Y) < alpha2):
                    c1_empty = False
                if ((c2x - points[k].X) * (c2x - points[k].X) + (c2y - points[k].Y) * (c2y - points[k].Y) < alpha2):
                    c2_empty = False
                if not c1_empty and not c2_empty:
                    break
            if c1_empty or c2_empty:
                res.append(Line.ByStartPointEndPoint(p, points[j]))
                #res.append(c1_empty)
    return res
# Assign your output to the OUT variable.
OUT = concave_hull_
# ----------------------------------------
code_block_7 = CodeBlock(allBeams=all_elements_of_category) { allBeams; }
getLevelsDict = Python(IN[0]=all_elements_of_category)  # CPython3
# ---------- getLevelsDict.python (89 lines) ----------
# Load the Python Standard and DesignScript Libraries
import sys
import clr
clr.AddReference('ProtoGeometry')
from Autodesk.DesignScript.Geometry import *

################Module For Functional Programing#########################
from functools import reduce; from itertools import chain
from itertools import groupby; import operator
from copy import deepcopy
curry = lambda f: lambda a,*args: f(a, *args) if (len(args)) else lambda *args: f(a, *args)

filter, map, reduce = curry(filter), curry(map), curry(reduce)

go = lambda *args: reduce(lambda a,f: f(a), args) ## 함수도 축약 가능 ##

def dictUpdate(dic1,dic2):
    dic1.update(dic2)
    return dic1
    
def dictsMerge(dics):
    res = reduce(dictUpdate, dics)
    return res
    
def dictDeleteKeys(dic, keys):
    for k in keys:
        del dic[k]
    return dic

def flat(a):
    if isinstance(a, list):
        for i in a: 
            yield from flat(i)
    else: yield a

def grpBy(iter, key):
    f,keys,grps = key,[],[]
    sorted_ = sorted(iter, key=f)
    for key, grp_data in groupby(sorted_,key=f):
        keys.append(key); grps.append(list(grp_data))
    return grps,keys
#########################################################################
# The inputs to this node will be stored as a list in the IN variables.
dataEnteringNode = IN
allFrames = IN[0]
# Place your code below this line

def getAllFrameLvs(allFrames):
    allFrames_loc = list(map(lambda x: x.GetLocation(),allFrames))
    allFrameLvElevations = go(
        allFrames_loc,
        map(lambda x: x.StartPoint.Z),set,
        sorted,
    )
    return allFrameLvElevations

def getAllLvs(allFrames):
    allLvElevations = getAllFrameLvs(allFrames)
    if 0 in allLvElevations:
        res = allLvElevations
    elif 0 not in allLvElevations:
        res = [0] + allLvElevations
    
    return res

def index_toName(datas):
    rngsStr = list(map(str, range(len(datas))))
    allNames = go(
        rngsStr,
        map(lambda x: "0" + x if len(x) < 2 else x)
    )
    return allNames

def getLevelsDict(allFrames):
    allFrames_loc = list(map(lambda x: x.GetLocation(), allFrames))
    allLvElevations = getAllLvs(allFrames)
    
    lvNames = index_toName(allLvElevations)
    
    resDict = go(
        zip(lvNames, allLvElevations),
        dict,
    )
    
    return resDict

res = getLevelsDict(allFrames)
# Assign your output to the OUT variable.
OUT = res
# ----------------------------------------
categories_3 = Categories("OST_StructuralColumns")
all_elements_of_category_3 = ElementsOfCategory(Category=categories_3)
allCols = CodeBlock(allCols=all_elements_of_category_3) { allCols; }
find_longitudinalaxis_건물의_장축방향 = Python(IN[0]=allCols)  # "find_longitudinalAxis(건물의 장축방향 벡터)"; CPython3
# ---------- find_longitudinalaxis_건물의_장축방향.python (85 lines) ----------
# Load the Python Standard and DesignScript Libraries
import sys
import clr
clr.AddReference('ProtoGeometry')
from Autodesk.DesignScript.Geometry import *

################Module For Functional Programing#########################
from functools import reduce; from itertools import chain
from itertools import groupby; import operator
from copy import deepcopy
curry = lambda f: lambda a,*args: f(a, *args) if (len(args)) else lambda *args: f(a, *args)

filter, map, reduce = curry(filter), curry(map), curry(reduce)

go = lambda *args: reduce(lambda a,f: f(a), args) ## 함수도 축약 가능 ##

def dictUpdate(dic1,dic2):
    dic1.update(dic2)
    return dic1
    
def dictsMerge(dics):
    res = reduce(dictUpdate, dics)
    return res
    
def dictDeleteKeys(dic, keys):
    for k in keys:
        del dic[k]
    return dic

def flat(a):
    if isinstance(a, list):
        for i in a: 
            yield from flat(i)
    else: yield a

def grpBy(iter, key):
    f,keys,grps = key,[],[]
    sorted_ = sorted(iter, key=f)
    for key, grp_data in groupby(sorted_,key=f):
        keys.append(key); grps.append(list(grp_data))
    return grps,keys
#########################################################################
# The inputs to this node will be stored as a list in the IN variables.
dataEnteringNode = IN
allCols = IN[0]
# Place your code below this line
def index_toName(datas):
    rngsStr = list(map(str, range(len(datas))))
    allNames = go(
        rngsStr,
        map(lambda x: "0" + x if len(x) < 2 else x)
    )
    return allNames
    
def get_BuilingBdBox(allCols):
    allCols_loc = list(map(lambda x: x.GetLocation(),allCols))
    bdBox = BoundingBox.ByGeometry(allCols_loc).ToCuboid()
    return bdBox

def find_longitudinalAxis(allCols):
    bdBox = get_BuilingBdBox(allCols)
    btmFace_PeriLine = go(
        bdBox,
        lambda x: x.Explode(),
        filter(lambda x: x.NormalAtParameter(0.5,0.5).Z == -1),
        list, lambda x: x[0],
        lambda x: x.PerimeterCurves(),
    )
    longitudinalVec = go(
        btmFace_PeriLine,
        map(lambda x: x.Length), max,
        lambda x: filter(lambda y: y.Length == x, btmFace_PeriLine),
        list,lambda x:x[0],
        lambda x: x.Direction.Normalized(),
    )
    if longitudinalVec.X < 0 or longitudinalVec.Y < 0:
        longitudinalVec = longitudinalVec.Reverse()
    else:
        pass
    
    return longitudinalVec

res = find_longitudinalAxis(allCols)
# Assign your output to the OUT variable.
OUT = res
# ----------------------------------------
get_framenodict_장축방향 = Python(IN[0]=allCols, IN[1]=find_longitudinalaxis_건물의_장축방향)  # CPython3
# ---------- get_framenodict_장축방향.python (83 lines) ----------
# Load the Python Standard and DesignScript Libraries
import sys
import clr
clr.AddReference('ProtoGeometry')
from Autodesk.DesignScript.Geometry import *

################Module For Functional Programing#########################
from functools import reduce; from itertools import chain
from itertools import groupby; import operator
from copy import deepcopy
curry = lambda f: lambda a,*args: f(a, *args) if (len(args)) else lambda *args: f(a, *args)

filter, map, reduce = curry(filter), curry(map), curry(reduce)

go = lambda *args: reduce(lambda a,f: f(a), args) ## 함수도 축약 가능 ##

def dictUpdate(dic1,dic2):
    dic1.update(dic2)
    return dic1
    
def dictsMerge(dics):
    res = reduce(dictUpdate, dics)
    return res
    
def dictDeleteKeys(dic, keys):
    for k in keys:
        del dic[k]
    return dic

def flat(a):
    if isinstance(a, list):
        for i in a: 
            yield from flat(i)
    else: yield a

def grpBy(iter, key):
    f,keys,grps = key,[],[]
    sorted_ = sorted(iter, key=f)
    for key, grp_data in groupby(sorted_,key=f):
        keys.append(key); grps.append(list(grp_data))
    return grps,keys
#########################################################################
# The inputs to this node will be stored as a list in the IN variables.
dataEnteringNode = IN
allCols = IN[0]
bdLongiVec = IN[1]
# Place your code below this line
def index_toName(datas):
    rngsStr = list(map(str, range(len(datas))))
    allNames = go(
        rngsStr,
        map(lambda x: "0" + x if len(x) < 2 else x)
    )
    return allNames
    
def get_SpansDict(allCols, bdLongiVec):
    xSpans = go(
        allCols,
        lambda x: grpBy(x, lambda x: x.GetLocation().StartPoint.X)[1],
        sorted,list
    )
    ySpans = go(
        allCols,
        lambda x: grpBy(x, lambda x: x.GetLocation().StartPoint.Y)[1],
        sorted,list
    )
    
    if bdLongiVec.IsParallel(Vector.XAxis()):
        spans = xSpans
    elif bdLongiVec.IsParallel(Vector.YAxis()):
        spans = ySpans
    
    spanNames = index_toName(spans)
    resDict = go(
        zip(spanNames, spans),
        dict,
    )
    return resDict


res = get_SpansDict(allCols, bdLongiVec), get_SpansDict(allCols, bdLongiVec.Rotate(Vector.ZAxis(), 90) )
# Assign your output to the OUT variable.
OUT = res
# ----------------------------------------
longAxis = CodeBlock(i=get_framenodict_장축방향) { i[0]; }
shortAxis = CodeBlock(i=get_framenodict_장축방향) { i[1]; }
allCols_2 = CodeBlock(allCols=allCols) { allCols; }
탄성계수 = CodeBlock { 210000; }
toDict_allBeams = Python(IN[0]=code_block_7, IN[1]=getLevelsDict, IN[2]=longAxis, IN[3]=shortAxis, IN[4]=allCols_2, IN[5]=탄성계수)  # CPython3
# ---------- toDict_allBeams.python (194 lines) ----------
# Load the Python Standard and DesignScript Libraries
import sys
import clr
clr.AddReference('ProtoGeometry')
from Autodesk.DesignScript.Geometry import *

################Module For Functional Programing#########################
from functools import reduce; from itertools import chain
from itertools import groupby; import operator
from copy import deepcopy
curry = lambda f: lambda a,*args: f(a, *args) if (len(args)) else lambda *args: f(a, *args)

filter, map, reduce = curry(filter), curry(map), curry(reduce)

go = lambda *args: reduce(lambda a,f: f(a), args) ## 함수도 축약 가능 ##

def dictUpdate(dic1,dic2):
    dic1.update(dic2)
    return dic1
    
def dictsMerge(dics):
    res = reduce(dictUpdate, dics)
    return res
    
def dictDeleteKeys(dic, keys):
    for k in keys:
        del dic[k]
    return dic

def flat(a):
    if isinstance(a, list):
        for i in a: 
            yield from flat(i)
    else: yield a

def grpBy(iter, key):
    f,keys,grps = key,[],[]
    sorted_ = sorted(iter, key=f)
    for key, grp_data in groupby(sorted_,key=f):
        keys.append(key); grps.append(list(grp_data))
    return grps,keys
#########################################################################
# The inputs to this node will be stored as a list in the IN variables.
dataEnteringNode = IN
allLvsDict = IN[1]
allBeams = IN[0]
frameNoDict = IN[2]
shortAxisNoDict = IN[3]
allCols = IN[4]
input_E = IN[5]
# Place your code below this line
def chck_intsctWithCols(frame, allColsGeo):
    frameLocation = frame\
                    .GetLocation()\
                    .ExtendStart(500)\
                    .ExtendEnd(500)
    res = frameLocation.DoesIntersect(allColsGeo)
    
    return res

def filter_allGirders(allBeamsDicts, allCols):
    allColsGeo = go(
        allCols,
        map(lambda x: x.Geometry()[0]),list,
        Solid.ByUnion,
    )
    res = go(
        allBeamsDicts,list,
        filter(lambda x: chck_intsctWithCols(x, allColsGeo)),
        list,
    )
    return res



def toDict_allGirders(allGirders, frameNoDict, allLvsDict, shortAxisNoDict, input_E):
    
    def find_Ix(elem):
        _tw = elem.GetParameterValueByName("Family and Type")\
            .GetParameterValueByName("Web Thickness") * 10
        _tf = elem.GetParameterValueByName("Family and Type")\
            .GetParameterValueByName("Flange Thickness") * 10
        _h = elem.GetParameterValueByName("Family and Type")\
            .GetParameterValueByName("Height") * 10
        _bf = elem.GetParameterValueByName("Family and Type")\
            .GetParameterValueByName("Width") * 10
        
        Ix = (2*(_bf*_tf**3/12+_bf*_tf*((_h-2*_tf)/2+_tf/2)**2)+_tw*(_h-2*_tf)**3/12)
        Ix_revit = elem.GetParameterValueByName("Family and Type")\
            .GetParameterValueByName("Moment of Inertia strong axis") * 10**4
        return Ix_revit
    
    def find_numberNameByElem(elem, nameDict, axis):
        tgtDict = {
            "X": elem.GetLocation().StartPoint.X,
            "Y": elem.GetLocation().StartPoint.Y,
            "Z": elem.GetLocation().StartPoint.Z,
        }
        res = []
        tgt = tgtDict[axis]
        for k,v in list(nameDict.items()):
            if v == tgt:
                res.append(k)
        return res

    def find_numberNameByPt(pt, nameDict, axis):
        tgtDict = {
            "X": pt.X,
            "Y": pt.Y,
            "Z": pt.Z,
        }
        res = []
        tgt = tgtDict[axis]
        for k,v in list(nameDict.items()):
            if v == tgt:
                res.append(k)
        return res

    def find_nodeName(elem, frameNoDict, shortAxisNoDict, allLvsDict):
        sttPt = elem.GetLocation().StartPoint
        
        endPt = elem.GetLocation().EndPoint
        
        name_stt_X = find_numberNameByPt(sttPt, frameNoDict, "X")[0]
        name_stt_Y = find_numberNameByPt(sttPt, shortAxisNoDict, "Y")[0]
        name_stt_Z = find_numberNameByPt(sttPt, allLvsDict, "Z")[0]
        name_stt = "1" + name_stt_X + name_stt_Y + name_stt_Z
        
        sttNodeDict = dict([("name",name_stt), ("X",sttPt.X), ("Z",sttPt.Z)])
        
        name_end_X = find_numberNameByPt(endPt, frameNoDict, "X")[0]
        name_end_Y = find_numberNameByPt(endPt, shortAxisNoDict, "Y")[0]
        name_end_Z = find_numberNameByPt(endPt, allLvsDict, "Z")[0]
        name_end = "1" + name_end_X + name_end_Y + name_end_Z
        
        endNodeDict = dict([("name",name_end), ("X",endPt.X), ("Z",endPt.Z)])
        
        return sttNodeDict, endNodeDict
        
    def find_elemDirection(line):
        lineVector = line.Direction.Normalized()
        if abs(lineVector.X) > 0:
            res = "longAxis"
        elif abs(lineVector.Y) > 0:
            res = "shortAxis"
        return res

    def convertElementName(elem, replaceIDX, replaceChar):
        element_name = list(find_nodeName(elem, frameNoDict, shortAxisNoDict, allLvsDict)[0]["name"])
        element_name[replaceIDX] = replaceChar
        element_name_modified = "".join(element_name)
        return element_name_modified

    resDict = go(
        allGirders,
        map( lambda x: {
            "elem": x,
            "element_name": convertElementName(x, 0, "3"),
            "sectionProp":{
                "name": x.GetParameterValueByName("Type").GetParameterValueByName("Type Name"),
                "sectionRotating": x.GetParameterValueByName("Cross-Section Rotation"),
                "A": x.GetParameterValueByName("Family and Type")\
                .GetParameterValueByName("Section Area") * 10**2,
                "I": find_Ix(x),
                "E": input_E,
            },
            "GUID": x.GetParameterValueByName("IfcGUID"),
            "role": "Girders",
            "location_line": x.GetLocation(),
            # 노드 추가
            "startNode": find_nodeName(x, frameNoDict, shortAxisNoDict, allLvsDict)[0],
            "endNode": find_nodeName(x, frameNoDict, shortAxisNoDict, allLvsDict)[1],
            "planeDirection": find_elemDirection(x.GetLocation()),
            "length": x.GetLocation().Length,
            "asgned_srfs": [],
            "asgned_area": 0,
            "frameNo": find_numberNameByElem(x, frameNoDict, "X")[0],
            "lvBelong": find_numberNameByElem(x, allLvsDict, "Z")[0],
            "sideBelong": [] ,
        } )
    )
    return resDict

#allBeamsDicts = toDict_allBeams(allBeams, frameNoDict, allLvsDict)
allGirders = filter_allGirders(allBeams, allCols)

allGirdersDicts = toDict_allGirders(allGirders, frameNoDict, allLvsDict, shortAxisNoDict, input_E)

#allGirdersDicts_X = list(filter(lambda x: x["planeDirection"]=="shortAxis", allGirdersDicts))

res = allGirdersDicts

# Assign your output to the OUT variable.
OUT = res
# ----------------------------------------
code_block_8 = CodeBlock(i=toDict_allBeams) { List.GroupByKey(i["elem"], i["elem"].GetParameterValueByName("Reference Level Elevation"))["groups"]; }
전층_경간_면_생성 = Python(IN[0]=concave_hull, IN[1]=code_block_8)  # CPython3
# ---------- 전층_경간_면_생성.python (144 lines) ----------
# Load the Python Standard and DesignScript Libraries
import sys
import clr
clr.AddReference('ProtoGeometry')
from Autodesk.DesignScript.Geometry import *
from Autodesk.DesignScript.Geometry import Line

from math import sqrt, hypot
from itertools import combinations
################Module For Functional Programing#########################
from functools import reduce; from itertools import chain
from itertools import groupby; import operator
from copy import deepcopy
curry = lambda f: lambda a,*args: f(a, *args) if (len(args)) else lambda *args: f(a, *args)

filter, map, reduce = curry(filter), curry(map), curry(reduce)

go = lambda *args: reduce(lambda a,f: f(a), args) ## 함수도 축약 가능 ##

def dictUpdate(dic1,dic2):
    dic1.update(dic2)
    return dic1
    
def dictsMerge(dics):
    res = reduce(dictUpdate, dics)
    return res
    
def dictDeleteKeys(dic, keys):
    for k in keys:
        del dic[k]
    return dic

def flat(a):
    if isinstance(a, list):
        for i in a: 
            yield from flat(i)
    else: yield a

def grpBy(iter, key):
    f,keys,grps = key,[],[]
    sorted_ = sorted(iter, key=f)
    for key, grp_data in groupby(sorted_,key=f):
        keys.append(key); grps.append(list(grp_data))
    return grps,keys
#########################################################################
    
# The inputs to this node will be stored as a list in the IN variables.
dataEnteringNode = IN
concave_hull = IN[0]
#loadPerLevel = IN[1]
elems_forAllLv = IN[1]
#gridsX, gridsY = grids

# Place your code below this line


def grp_XYbeamsLinesPerLv(elemsPerLv):
    allLines = go(
        elemsPerLv,
        map(lambda x: x.GetLocation()),
        list,
    )
    directionsPerLevel = go(
        allLines,
        map(lambda x: x.Direction),
        map(lambda x: x.Normalized()),
        list,
    )
    
    isParallel = lambda e: go(
        e,
        lambda x: x.Direction,
        lambda x: x.Normalized(),
        lambda x: not x.IsParallel(directionsPerLevel[0]),
    )
    
    
    return grpBy(allLines, isParallel)[0]

def make_pairFrames(xGrps, yGrps):
    pairX = go(
        xGrps,
        lambda x: sorted(x, key=lambda e: e.StartPoint.X),
        lambda x: grpBy(x, key=lambda e: e.StartPoint.X)[0],
        map(lambda x: sorted(x, key=lambda e: e.StartPoint.Y)),
        #2개씩 1간격으로 서브리스트 생성
        map(lambda x: list(map(lambda n: x[n:n+1+1], range(len(x))[:-1]))),
        lambda x: list(chain(*x)),
    )
    pairY = go(
        yGrps,
        lambda x: sorted(x, key=lambda e: e.StartPoint.X),
        lambda x: grpBy(x, key=lambda e: e.StartPoint.X)[0],
        map(lambda x: sorted(x, key=lambda e: e.StartPoint.Y)),list,
        #2개씩 1간격으로 서브리스트 생성
        lambda x: list(map(lambda n: x[n:n+1+1], range(len(x))[:-1])),
        # 서브리스트 구조 Transpose
        map(lambda x: list(zip(*chain(x)))),
        lambda x: list(chain(*x)),
    )
    return pairX, pairY

def get_IntersectInGrp(xGrp, yGrp):
    res = []
    for x in xGrp:
        for y in yGrp:
            res.append(x.Intersect(y))
    return list(chain(*res))

def GetBoundingSrfs(intscts):
    res = []
    try:
        crvSet = concave_hull(intscts, 100000)
        polyCrv = PolyCurve.ByJoinedCurves(crvSet)
        srf = Surface.ByPatch(polyCrv)
        srfThick = srf.Thicken(10,False)
#        bdCube = BoundingBox.ByGeometry(srfThick).ToCuboid()
#        bdCubeSrfs = bdCube.Explode()
#        bdBelowSrf = go(
#            bdCube.Explode(),
#            #bdCubeSrfs,
#            filter(lambda x: x.NormalAtParameter(0.5,0.5).Z != 0),
#            list,
#        )[0]
        return srf
    except: pass

def makeSrf_btwnFrame(xGrps, yGrps):
    res = []
    for xGrp in xGrps:
        for yGrp in yGrps:
            intscts = get_IntersectInGrp(xGrp, yGrp)
            if GetBoundingSrfs(intscts):
                res.append(GetBoundingSrfs(intscts))

    return res


# Assign your output to the OUT variable.
XY_elems_forAllLv = list(map(grp_XYbeamsLinesPerLv, elems_forAllLv))
pairFrames_forAllLv = list(map(lambda x: list(make_pairFrames(*x)), XY_elems_forAllLv))
srfs_forAllLv = list(map(lambda x: list(makeSrf_btwnFrame(*x)), pairFrames_forAllLv))

OUT = srfs_forAllLv
# ----------------------------------------
전층_경간면_내부_등분선_찾기 = Python(IN[0]=concave_hull, IN[1]=전층_경간_면_생성)  # CPython3
# ---------- 전층_경간면_내부_등분선_찾기.python (168 lines) ----------
# Load the Python Standard and DesignScript Libraries
import sys
import clr
clr.AddReference('ProtoGeometry')
from Autodesk.DesignScript.Geometry import *

################Module For Functional Programing#########################
from functools import reduce; from itertools import chain
from itertools import groupby; import operator
from copy import deepcopy
curry = lambda f: lambda a,*args: f(a, *args) if (len(args)) else lambda *args: f(a, *args)

filter, map, reduce = curry(filter), curry(map), curry(reduce)

go = lambda *args: reduce(lambda a,f: f(a), args) ## 함수도 축약 가능 ##

def dictUpdate(dic1,dic2):
    dic1.update(dic2)
    return dic1
    
def dictsMerge(dics):
    res = reduce(dictUpdate, dics)
    return res
    
def dictDeleteKeys(dic, keys):
    for k in keys:
        del dic[k]
    return dic

def flat(a):
    if isinstance(a, list):
        for i in a: 
            yield from flat(i)
    else: yield a

def grpBy(iter, key):
    f,keys,grps = key,[],[]
    sorted_ = sorted(iter, key=f)
    for key, grp_data in groupby(sorted_,key=f):
        keys.append(key); grps.append(list(grp_data))
    return grps,keys
#########################################################################


# The inputs to this node will be stored as a list in the IN variables.
dataEnteringNode = IN
concave_hull = IN[0]
srfs_forAllLv = IN[1]
# Place your code below this line

def find_allCorner(srf):
    u_stt = srf.PointAtParameter(0,1)
    u_end = srf.PointAtParameter(1,1)
    b_stt = srf.PointAtParameter(0,0)
    b_end = srf.PointAtParameter(1,0)
    
    return u_stt, u_end, b_stt, b_end

def find_shortSide(srf):
    u_stt, u_end, b_stt, b_end = find_allCorner(srf)
    u_shortSide = Line.ByStartPointEndPoint(u_stt, u_end)
    b_shortSide = Line.ByStartPointEndPoint(b_stt, b_end)
    
    return u_shortSide, b_shortSide
    
def find_longSide(srf):
    u_stt, u_end, b_stt, b_end = find_allCorner(srf)
    l_longSide = Line.ByStartPointEndPoint(u_stt, b_stt)
    r_longSide = Line.ByStartPointEndPoint(u_end, b_end)
    
    return l_longSide, r_longSide
    
def find_longSide_midLine(srf):
    u_shortSide, b_shortSide = find_shortSide(srf)
    u_midPt = u_shortSide.PointAtParameter(0.5)
    b_midPt = b_shortSide.PointAtParameter(0.5)
    midLine = Line.ByStartPointEndPoint(u_midPt, b_midPt)
    
    return midLine

def find_2wayRefPts(srf):
    u_shortSide, b_shortSide = find_shortSide(srf)
    shortSideLength = u_shortSide.Length
    u_midPt = u_shortSide.PointAtParameter(0.5)
    b_midPt = b_shortSide.PointAtParameter(0.5)
    midLine = find_longSide_midLine(srf)
    midLineVec = midLine.Direction
    srfNormalVec = srf.NormalAtParameter(0.5,0.5)
    
    u_circle = Circle.ByCenterPointRadiusNormal(u_midPt, shortSideLength/2, srfNormalVec)
    b_circle = Circle.ByCenterPointRadiusNormal(b_midPt, shortSideLength/2, srfNormalVec)
    u_45d_pt = midLine.Intersect(u_circle)[0]
    b_45d_pt = midLine.Intersect(b_circle)[0]
    
    return u_45d_pt, b_45d_pt

def div_srf_1way(srf):
    u_stt, u_end, b_stt, b_end = find_allCorner(srf)
    u_shortSide, b_shortSide = find_shortSide(srf)
    u_midPt = u_shortSide.PointAtParameter(0.5)
    b_midPt = b_shortSide.PointAtParameter(0.5)
    
    l_srf = go(
        [u_stt, b_stt, u_midPt, b_midPt],
        lambda x: concave_hull(x, 100000),
        PolyCurve.ByJoinedCurves,
        Surface.ByPatch,
    )
    r_srf = go(
        [u_end, b_end, u_midPt, b_midPt],
        lambda x: concave_hull(x, 100000),
        PolyCurve.ByJoinedCurves,
        Surface.ByPatch,
    )
    
    return l_srf, r_srf

def div_srf_2way(srf):
    u_stt, u_end, b_stt, b_end = find_allCorner(srf)
    u_45d_pt, b_45d_pt = find_2wayRefPts(srf)
    
    l_srf = go(
        [u_stt, b_stt, u_45d_pt, b_45d_pt],
        #lambda x: concave_hull(x, 100000),  ## concave_hull 에서 근접점 오류 발생
        Polygon.ByPoints,
        PolyCurve.ByJoinedCurves,
        Surface.ByPatch,
    )
#    r_srf = go(
#        [u_end, b_end, u_45d_pt, b_45d_pt],
#        lambda x: concave_hull(x, 100000),
#        PolyCurve.ByJoinedCurves,
#        Surface.ByPatch,
#    )
#    u_srf =  go(
#        [u_stt, u_end, u_45d_pt],
#        lambda x: concave_hull(x, 100000),
#        PolyCurve.ByJoinedCurves,
#        Surface.ByPatch,
#    )
#    b_srf = go(
#        [b_stt, b_end, b_45d_pt],
#        lambda x: concave_hull(x, 100000),
#        PolyCurve.ByJoinedCurves,
#        Surface.ByPatch,
#    )
    
    return l_srf, r_srf, u_srf, b_srf

def div_srf(srf):
    u_stt, u_end, b_stt, b_end = find_allCorner(srf)
    shortSide = find_shortSide(srf)[0].Length
    longSide = find_longSide(srf)[0].Length
    ratio = longSide/shortSide
    
    if ratio < 2:
        #res = [{"srf": x, "load_path": "2way"} for x in div_srf_2way(srf)] ## srfDict 형태로 반환
        res = [{"srf": x, "load_path": "1way"} for x in div_srf_1way(srf)]
    elif ratio >= 2:
        res = [{"srf": x, "load_path": "1way"} for x in div_srf_1way(srf)]
    
    return res

def div_srf_perLv(srfsPerLv):
    return list(chain(*map(div_srf, srfsPerLv)))

# Assign your output to the OUT variable.
OUT = map(div_srf_perLv, srfs_forAllLv)
# ----------------------------------------
n1_dl_층별_정보_kn_m² = StringInput("""34.05
15.05
4.1
0.35""")  # "1. DL 층별 정보(kN/m²)"; graph input
code_block_9 = CodeBlock { " "; "\n"; }
split_4 = String.Split(string=n1_dl_층별_정보_kn_m², separator0=code_block_9.out0, separator1=code_block_9.out1)
count = List.Count(list=split_4)
거더_필터링_기둥과_교차_여부 = Python(IN[0]=all_elements_of_category, IN[1]=all_elements_of_category_3, IN[2]=count)  # CPython3
# ---------- 거더_필터링_기둥과_교차_여부.python (110 lines) ----------
# Load the Python Standard and DesignScript Libraries
import sys
import clr
clr.AddReference('ProtoGeometry')
from Autodesk.DesignScript.Geometry import *

################Module For Functional Programing#########################
from functools import reduce; from itertools import chain
from itertools import groupby; import operator
from copy import deepcopy
curry = lambda f: lambda a,*args: f(a, *args) if (len(args)) else lambda *args: f(a, *args)

filter, map, reduce = curry(filter), curry(map), curry(reduce)

go = lambda *args: reduce(lambda a,f: f(a), args) ## 함수도 축약 가능 ##

def dictUpdate(dic1,dic2):
    dic1.update(dic2)
    return dic1
    
def dictsMerge(dics):
    res = reduce(dictUpdate, dics)
    return res
    
def dictDeleteKeys(dic, keys):
    for k in keys:
        del dic[k]
    return dic

def flat(a):
    if isinstance(a, list):
        for i in a: 
            yield from flat(i)
    else: yield a

def grpBy(iter, key):
    f,keys,grps = key,[],[]
    sorted_ = sorted(iter, key=f)
    for key, grp_data in groupby(sorted_,key=f):
        keys.append(key); grps.append(list(grp_data))
    return grps,keys
#########################################################################

# The inputs to this node will be stored as a list in the IN variables.
dataEnteringNode = IN
allFrames = IN[0]
allCols = IN[1]
userinputStory = IN[2]
# Place your code below this line

def chck_intsctWithCols(frame, allColsGeo):
    frameLocation = frame\
                    .GetLocation()\
                    .ExtendStart(500)\
                    .ExtendEnd(500)
    res = frameLocation.DoesIntersect(allColsGeo)
    
    return res

def filter_allGirders(allFrames, allCols):
    allColsGeo = go(
        allCols,
        map(lambda x: x.Geometry()[0]),list,
        Solid.ByUnion,
    )
    res = go(
        allFrames,
        filter(lambda x: chck_intsctWithCols(x, allColsGeo)),
        list,
    )
    return res

allGirders = filter_allGirders(allFrames, allCols)

def find_allLinePts(allGirders, allCols):
    # 거더는 StartPoint 혹은 레퍼런스 레벨별로 그루핑해서
    # Z 값은 레벨에서의 StartPoint 만 가져와서 구배는 반영안하도록
    girdersPerRefLvGrp = grpBy(allGirders, lambda x: x.GetParameterValueByName("Reference Level Elevation") )
    
    girdersLines = list(map(lambda x: x.GetLocation(), allGirders))
    girdersPts = [x.StartPoint for x in girdersLines] + \
                 [x.EndPoint for x in girdersLines]
    colsLines = go(
        allCols,
        map(lambda x: x.GetLocation()),
        list,
    )
    colsPts = [x.StartPoint for x in colsLines] + \
              [x.EndPoint for x in colsLines]
    allPts = girdersPts + colsPts
    allX = go(
        allPts,
        map(lambda x: x.X), set,
        sorted,
    )
    allY = go(
        allPts,
        map(lambda x: x.Y), set,
        sorted,
    )
    allZ = go(
        allPts,
        map(lambda x: x.Z), set,
        sorted,
    )
    
    return girdersPerRefLvGrp, allZ

# Assign your output to the OUT variable.
OUT = allGirders, find_allLinePts(allGirders, allCols)
# ----------------------------------------
code_block_10 = CodeBlock(i=거더_필터링_기둥과_교차_여부) { i[0]; }
code_block_11 = CodeBlock(frames=code_block_10) { frames; }
code_block_12 = CodeBlock { "Reference Level Elevation"; }
getParameterValueByName_2 = Element.GetParameterValueByName(element=code_block_11, parameterName=code_block_12)
groupByKey = List.GroupByKey(list=code_block_11, keys=getParameterValueByName_2)
code_block_13 = CodeBlock(elems_forAllLv=groupByKey.groups) { elems_forAllLv; }
element_별_하중srf_할당_frame = Python(IN[1]=전층_경간면_내부_등분선_찾기, IN[2]=code_block_13)  # CPython3; frozen; unwired: IN[0]
# ---------- element_별_하중srf_할당_frame.python (123 lines) ----------
# Load the Python Standard and DesignScript Libraries
import sys
import clr
clr.AddReference('ProtoGeometry')
from Autodesk.DesignScript.Geometry import *

################Module For Functional Programing#########################
from functools import reduce; from itertools import chain
from itertools import groupby; import operator
from copy import deepcopy
curry = lambda f: lambda a,*args: f(a, *args) if (len(args)) else lambda *args: f(a, *args)

filter, map, reduce = curry(filter), curry(map), curry(reduce)

go = lambda *args: reduce(lambda a,f: f(a), args) ## 함수도 축약 가능 ##

def dictUpdate(dic1,dic2):
    dic1.update(dic2)
    return dic1
    
def dictsMerge(dics):
    res = reduce(dictUpdate, dics)
    return res
    
def dictDeleteKeys(dic, keys):
    for k in keys:
        del dic[k]
    return dic

def flat(a):
    if isinstance(a, list):
        for i in a: 
            yield from flat(i)
    else: yield a

def grpBy(iter, key):
    f,keys,grps = key,[],[]
    sorted_ = sorted(iter, key=f)
    for key, grp_data in groupby(sorted_,key=f):
        keys.append(key); grps.append(list(grp_data))
    return grps,keys
#########################################################################

# The inputs to this node will be stored as a list in the IN variables.
dataEnteringNode = IN
srfs_forAllLv = IN[1]
elems_forAllLv = IN[2]
# Place your code below this line
def grp_XYbeamsPerLv(elemsPerLv):
#    allLines = go(
#        elemsPerLv,
#        map(lambda x: x.GetLocation()),
#        list,
#    )
    directionsPerLevel = go(
        elemsPerLv,
        map(lambda x: x.GetLocation()),
        map(lambda x: x.Direction),
        map(lambda x: x.Normalized()),
        list,
    )
    
    isParallel = lambda e: go(
        e,
        lambda x: x.GetLocation(),
        lambda x: x.Direction,
        lambda x: x.Normalized(),
        lambda x: not x.IsParallel(directionsPerLevel[0]),
    )
    
    
    return grpBy(elemsPerLv, isParallel)[0]

elemsX_forAllLv = go(
    elems_forAllLv,
    map(grp_XYbeamsPerLv),
    list,
    map(lambda x: x[1]),
    list,
)

elemsY_forAllLv = go(
    elems_forAllLv,
    map(grp_XYbeamsPerLv),
    list,
    map(lambda x: x[0]),
    list,
)

def find_intsctSrfs(elem, srfs_perLv):
    #elemGeo = elem.Geometry()
    elemLineforChck = elem\
                        .GetLocation()\
                        .ExtendStart(-100)\
                        .ExtendEnd(-100)
    assignedSrfs = go(
        srfs_perLv,
        filter(lambda x: x["load_path"]=="1way"),
        filter(lambda x: elemLineforChck.DoesIntersect(x["srf"])),
        list,
    )
    
    res = {
        "elem": elem,
        "location_line": elem.GetLocation(),
        "length": elem.GetLocation().Length,
        "asgned_Srfs": list(map(lambda x: x["srf"], assignedSrfs)),
        "asgned_area": round(sum(list(map(lambda x: x["srf"].Area/1000000, assignedSrfs))),2)
    }
    
    return res

def find_intsctSrfsPerLv(elemsPerLv, srfs_perLv):
    return list(map(lambda x: find_intsctSrfs(x, srfs_perLv), elemsPerLv))

res = go(
    elemsX_forAllLv,
    lambda x: list(zip(x, srfs_forAllLv)),
    map(lambda x: find_intsctSrfsPerLv(*x)),
)

# Assign your output to the OUT variable.
OUT = res
# ----------------------------------------
code_block_14 = CodeBlock(i=element_별_하중srf_할당_frame) { i["asgned_Srfs"]; }
code_block_15 = CodeBlock(i=element_별_하중srf_할당_frame) { i["elem"].Geometry(); }
code_block_16 = CodeBlock(i=all_elements_of_category_3) { i.Geometry(); }
code_block_17 = CodeBlock(i=toDict_allBeams) { i; }
element_별_하중srf_할당_frame_2 = Python(IN[1]=전층_경간면_내부_등분선_찾기, IN[2]=code_block_17)  # CPython3; unwired: IN[0]
# ---------- element_별_하중srf_할당_frame_2.python (100 lines) ----------
# Load the Python Standard and DesignScript Libraries
import sys
import clr
clr.AddReference('ProtoGeometry')
from Autodesk.DesignScript.Geometry import *

################Module For Functional Programing#########################
from functools import reduce; from itertools import chain
from itertools import groupby; import operator
from copy import deepcopy
curry = lambda f: lambda a,*args: f(a, *args) if (len(args)) else lambda *args: f(a, *args)

filter, map, reduce = curry(filter), curry(map), curry(reduce)

go = lambda *args: reduce(lambda a,f: f(a), args) ## 함수도 축약 가능 ##

def dictUpdate(dic1,dic2):
    dic1.update(dic2)
    return dic1
    
def dictsMerge(dics):
    res = reduce(dictUpdate, dics)
    return res
    
def dictDeleteKeys(dic, keys):
    for k in keys:
        del dic[k]
    return dic

def flat(a):
    if isinstance(a, list):
        for i in a: 
            yield from flat(i)
    else: yield a

def grpBy(iter, key):
    f,keys,grps = key,[],[]
    sorted_ = sorted(iter, key=f)
    for key, grp_data in groupby(sorted_,key=f):
        keys.append(key); grps.append(list(grp_data))
    return grps,keys
#########################################################################

# The inputs to this node will be stored as a list in the IN variables.
dataEnteringNode = IN
srfs_forAllLv = IN[1]
#elems_forAllLv = IN[2]
elemDicts = IN[2]
elemDicts_forAllLv = go(
    elemDicts,
    lambda x: grpBy(x, lambda e: e["elem"].GetParameterValueByName("Reference Level Elevation")),
    lambda x: x[0]
)
# Place your code below this line
elemDictsX_forAllLv = go(
    elemDicts_forAllLv,
    map(lambda x: grpBy(x, lambda d: d["planeDirection"])[0]),
    map(lambda x: x[1]),list,
)

elemDictsY_forAllLv = go(
    elemDicts_forAllLv,
    map(lambda x: grpBy(x, lambda d: d["planeDirection"])[0]),
    map(lambda x: x[1]),list,
)

def find_intsctSrfs(elemDict, srfs_perLv):
    
    elemLineforChck = elemDict["elem"]\
                        .GetLocation()\
                        .ExtendStart(-100)\
                        .ExtendEnd(-100)
    assignedSrfs = go(
        srfs_perLv,
        filter(lambda x: x["load_path"]=="1way"),
        filter(lambda x: elemLineforChck.DoesIntersect(x["srf"])),
        list,
    )
    elemDict["asgned_srfs"] = list(map(lambda x: x["srf"], assignedSrfs))
    elemDict["asgned_area"] = round(sum(list(map(lambda x: x["srf"].Area, assignedSrfs))),2)
    
    return elemDict


def find_intsctSrfsPerLv(elemDictsPerLv, srfs_perLv):
    res = go(
        elemDictsPerLv,
        map(lambda x: find_intsctSrfs(x, srfs_perLv)),
        list
    )
    return res

res = go(
    elemDictsX_forAllLv,
    lambda x: list(zip(x, srfs_forAllLv)),
    map(lambda x: find_intsctSrfsPerLv(*x)),
)

# Assign your output to the OUT variable.
OUT = res
# ----------------------------------------
toNumber = String.ToNumber(string=split_4)
code_block_18 = CodeBlock(i=toNumber) { i; }
하중_값_계산 = Python(IN[0]=element_별_하중srf_할당_frame_2, IN[1]=allCols, IN[2]=code_block_18)  # CPython3
# ---------- 하중_값_계산.python (81 lines) ----------
# Load the Python Standard and DesignScript Libraries
import sys
import clr
clr.AddReference('ProtoGeometry')
from Autodesk.DesignScript.Geometry import *

################Module For Functional Programing#########################
from functools import reduce; from itertools import chain
from itertools import groupby; import operator
from copy import deepcopy
curry = lambda f: lambda a,*args: f(a, *args) if (len(args)) else lambda *args: f(a, *args)

filter, map, reduce = curry(filter), curry(map), curry(reduce)

go = lambda *args: reduce(lambda a,f: f(a), args) ## 함수도 축약 가능 ##

def dictUpdate(dic1,dic2):
    dic1.update(dic2)
    return dic1
    
def dictsMerge(dics):
    res = reduce(dictUpdate, dics)
    return res
    
def dictDeleteKeys(dic, keys):
    for k in keys:
        del dic[k]
    return dic

def flat(a):
    if isinstance(a, list):
        for i in a: 
            yield from flat(i)
    else: yield a

def grpBy(iter, key):
    f,keys,grps = key,[],[]
    sorted_ = sorted(iter, key=f)
    for key, grp_data in groupby(sorted_,key=f):
        keys.append(key); grps.append(list(grp_data))
    return grps,keys
#########################################################################

# The inputs to this node will be stored as a list in the IN variables.
dataEnteringNode = IN
frameDict_forAllLv = IN[0]
allCols = IN[1]
DL_forAllLv = IN[2]
# Place your code below this line
allLvsDict_DL = go(
    frameDict_forAllLv,
    map(lambda DictsPerLv: 
        set(map(lambda d: d["lvBelong"], DictsPerLv))
    ), list,
    lambda x: chain(*x), list,sorted,
    lambda x: dict(zip(x, DL_forAllLv)),
)

def calcLoad(elemDict, loadKind, loadType, allLvsLoadDict):
    elemLv = elemDict["lvBelong"]
    asgned_area = elemDict["asgned_area"]
    DL_unitValueforElem = allLvsLoadDict[elemLv]
    calcRes = DL_unitValueforElem * asgned_area / (1000) 
    resDict = {
        "load_type": loadType,
        "wx": 0,
        "wy": -calcRes,
    }
    
    elemDict[loadKind] = resDict
    
    return elemDict

def calcLoadPerLv(elemDictsPerLv, loadKind, loadType, allLvsLoadDict):
    return list(map(lambda x: calcLoad(x, loadKind, loadType, allLvsLoadDict), elemDictsPerLv))

def calcLoad_forAllLv(elemDicts_forAllLv, loadKind, loadType, allLvsLoadDict):
    return list(map(lambda x: calcLoadPerLv(x, loadKind, loadType, allLvsLoadDict), elemDicts_forAllLv))

# Assign your output to the OUT variable.
OUT = calcLoad_forAllLv(frameDict_forAllLv, "DL", "uniform", allLvsDict_DL)
# ----------------------------------------
code_block_19 = CodeBlock(i=하중_값_계산) { i[0][5]["asgned_srfs"]; }
byPoints = Polygon.ByPoints()  # unwired: points
부재_별_노드명명_및_하중_값_계산 = Python(IN[0]=element_별_하중srf_할당_frame, IN[1]=allCols, IN[2]=code_block_18)  # CPython3
# ---------- 부재_별_노드명명_및_하중_값_계산.python (105 lines) ----------
# Load the Python Standard and DesignScript Libraries
import sys
import clr
clr.AddReference('ProtoGeometry')
from Autodesk.DesignScript.Geometry import *

################Module For Functional Programing#########################
from functools import reduce; from itertools import chain
from itertools import groupby; import operator
from copy import deepcopy
curry = lambda f: lambda a,*args: f(a, *args) if (len(args)) else lambda *args: f(a, *args)

filter, map, reduce = curry(filter), curry(map), curry(reduce)

go = lambda *args: reduce(lambda a,f: f(a), args) ## 함수도 축약 가능 ##

def dictUpdate(dic1,dic2):
    dic1.update(dic2)
    return dic1
    
def dictsMerge(dics):
    res = reduce(dictUpdate, dics)
    return res
    
def dictDeleteKeys(dic, keys):
    for k in keys:
        del dic[k]
    return dic

def flat(a):
    if isinstance(a, list):
        for i in a: 
            yield from flat(i)
    else: yield a

def grpBy(iter, key):
    f,keys,grps = key,[],[]
    sorted_ = sorted(iter, key=f)
    for key, grp_data in groupby(sorted_,key=f):
        keys.append(key); grps.append(list(grp_data))
    return grps,keys
#########################################################################

# The inputs to this node will be stored as a list in the IN variables.
dataEnteringNode = IN
frameDict_forAllLv = IN[0]
allCols = IN[1]
DL_forAllLv = IN[2]
# Place your code below this line
def make_NamingRef(frameDict_forAllLv, allCols):
    allElem_loc = \
        list(map(lambda x: x["location_line"], list(chain(*frameDict_forAllLv))))
    allCols_loc = \
        list(map(lambda x: x.GetLocation(), allCols))
    allPts = [x.StartPoint for x in allElem_loc] +\
            [x.EndPoint for x in allElem_loc] +\
            [x.StartPoint for x in allCols_loc] +\
            [x.EndPoint for x in allCols_loc]
    uniqAllPts = list(set(allPts))
    
    allUnique_X = sorted(list(set(map(lambda x: x.X, uniqAllPts))))
    allUnique_Y = sorted(list(set(map(lambda x: x.Y, uniqAllPts))))
    allUnique_Z = sorted(list(set(map(lambda x: x.Z, uniqAllPts))))
    
    xCnt = map(lambda x: "0"+str(x),range(1,len(allUnique_X)+1))
    xNames = list(zip(xCnt, allUnique_X))
    yCnt = map(lambda x: "0"+str(x),range(1,len(allUnique_Y)+1))
    yNames = list(zip(yCnt, allUnique_Y))
    zCnt = map(lambda x: "0"+str(x),range(1,len(allUnique_Z)+1))
    zNames = list(zip(zCnt, allUnique_Z))
    
    res = {
        "xNames": xNames,
        "yNames": yNames,
        "zNames": zNames,
    }
    
    return res

namingRef = make_NamingRef(frameDict_forAllLv, allCols)

def add_nodeNamingToDic(elemDict, namingRef):
    xNames, yNames, zNames = namingRef.values()
    
    sttPt = elemDict["location_line"].StartPoint
    endPt = elemDict["location_line"].EndPoint
    
    xName_s = list(filter(lambda x: sttPt.X == x[1], xNames))[0][0]
    yName_s = list(filter(lambda x: sttPt.Y == x[1], yNames))[0][0]
    zName_s = list(filter(lambda x: sttPt.Z == x[1], zNames))[0][0]
    
    xName_e = list(filter(lambda x: endPt.X == x[1], xNames))[0][0]
    yName_e = list(filter(lambda x: endPt.Y == x[1], yNames))[0][0]
    zName_e = list(filter(lambda x: endPt.Z == x[1], zNames))[0][0]
    
    elemDict["node2"] = "1" + xName_s + yName_s + zName_s
    elemDict["node1"] = "1" + xName_e + yName_e + zName_e
    
    return elemDict

def add_nodeNamingToDicPerLv(elemDict_perLv, namingRef):
    return list(map(lambda x: add_nodeNamingToDic(x, namingRef), elemDict_perLv))

# Assign your output to the OUT variable.
OUT = map(lambda x: add_nodeNamingToDicPerLv(x, namingRef), frameDict_forAllLv)
# ----------------------------------------
flatten_2 = List.Flatten(list=부재_별_노드명명_및_하중_값_계산)
code_block_20 = CodeBlock(i=flatten_2) { i["node1"]; }
code_block_21 = CodeBlock { 0; 3; }
substring = String.Substring(string=code_block_20, startIndex=code_block_21.out0, length=code_block_21.out1)
groupByKey_2 = List.GroupByKey(list=flatten_2, keys=substring)
code_block_22 = CodeBlock(i=groupByKey_2.groups) { i[1]; }
code_block_23 = CodeBlock(i=code_block_22) { i["location_line"]; }
code_block_24 = CodeBlock(i=code_block_22) { i["asgned_Srfs"]; }
parameters_2 = Element.Parameters(element=code_block_10)
전입면_경간_면_생성_col = Python(IN[0]=concave_hull, IN[1]=allCols)  # CPython3; frozen
# ---------- 전입면_경간_면_생성_col.python (146 lines) ----------
# Load the Python Standard and DesignScript Libraries
import sys
import clr
clr.AddReference('ProtoGeometry')
from Autodesk.DesignScript.Geometry import *
from Autodesk.DesignScript.Geometry import Line

from math import sqrt, hypot
from itertools import combinations
################Module For Functional Programing#########################
from functools import reduce; from itertools import chain
from itertools import groupby; import operator
from copy import deepcopy
curry = lambda f: lambda a,*args: f(a, *args) if (len(args)) else lambda *args: f(a, *args)

filter, map, reduce = curry(filter), curry(map), curry(reduce)

go = lambda *args: reduce(lambda a,f: f(a), args) ## 함수도 축약 가능 ##

def dictUpdate(dic1,dic2):
    dic1.update(dic2)
    return dic1
    
def dictsMerge(dics):
    res = reduce(dictUpdate, dics)
    return res
    
def dictDeleteKeys(dic, keys):
    for k in keys:
        del dic[k]
    return dic

def flat(a):
    if isinstance(a, list):
        for i in a: 
            yield from flat(i)
    else: yield a

def grpBy(iter, key):
    f,keys,grps = key,[],[]
    sorted_ = sorted(iter, key=f)
    for key, grp_data in groupby(sorted_,key=f):
        keys.append(key); grps.append(list(grp_data))
    return grps,keys
#########################################################################
    
# The inputs to this node will be stored as a list in the IN variables.
dataEnteringNode = IN
concave_hull = IN[0]
#loadPerLevel = IN[1]
elems_forAllLv = IN[1]
#gridsX, gridsY = grids

# Place your code below this line


def grp_XYbeamsLinesPerLv(elemsPerLv):
    allLines = go(
        elemsPerLv,
        map(lambda x: x.GetLocation()),
        list,
    )
    directionsPerLevel = go(
        allLines,
        map(lambda x: x.Direction),
        map(lambda x: x.Normalized()),
        list,
    )
    
    isParallel = lambda e: go(
        e,
        lambda x: x.Direction,
        lambda x: x.Normalized(),
        lambda x: not x.IsParallel(directionsPerLevel[0]),
    )
    
    
    return grpBy(allLines, isParallel)[0]

def make_pairFrames(xGrps, yGrps):
    pairX = go(
        xGrps,
        lambda x: sorted(x, key=lambda e: e.StartPoint.X),
        lambda x: grpBy(x, key=lambda e: e.StartPoint.X)[0],
        map(lambda x: sorted(x, key=lambda e: e.StartPoint.Y)),
        #2개씩 1간격으로 서브리스트 생성
        map(lambda x: list(map(lambda n: x[n:n+1+1], range(len(x))[:-1]))),
        lambda x: list(chain(*x)),
    )
    pairY = go(
        yGrps,
        lambda x: sorted(x, key=lambda e: e.StartPoint.X),
        lambda x: grpBy(x, key=lambda e: e.StartPoint.X)[0],
        map(lambda x: sorted(x, key=lambda e: e.StartPoint.Y)),list,
        #2개씩 1간격으로 서브리스트 생성
        lambda x: list(map(lambda n: x[n:n+1+1], range(len(x))[:-1])),
        # 서브리스트 구조 Transpose
        map(lambda x: list(zip(*chain(x)))),
        lambda x: list(chain(*x)),
    )
    return pairX, pairY

def get_IntersectInGrp(xGrp, yGrp):
    res = []
    for x in xGrp:
        for y in yGrp:
            res.append(x.Intersect(y))
    return list(chain(*res))

def GetBoundingSrfs(intscts):
    res = []
    try:
        crvSet = concave_hull(intscts, 100000)
        polyCrv = PolyCurve.ByJoinedCurves(crvSet)
        srf = Surface.ByPatch(polyCrv)
        srfThick = srf.Thicken(10,False)
#        bdCube = BoundingBox.ByGeometry(srfThick).ToCuboid()
#        bdCubeSrfs = bdCube.Explode()
#        bdBelowSrf = go(
#            bdCube.Explode(),
#            #bdCubeSrfs,
#            filter(lambda x: x.NormalAtParameter(0.5,0.5).Z != 0),
#            list,
#        )[0]
        return srf
    except: pass

def makeSrf_btwnFrame(xGrps, yGrps):
    res = []
    for xGrp in xGrps:
        for yGrp in yGrps:
            intscts = get_IntersectInGrp(xGrp, yGrp)
            if GetBoundingSrfs(intscts):
                res.append(GetBoundingSrfs(intscts))

    return res


# Assign your output to the OUT variable.
XY_elems_forAllLv = list(map(grp_XYbeamsLinesPerLv, elems_forAllLv))
pairFrames_forAllLv = list(map(lambda x: list(make_pairFrames(*x)), XY_elems_forAllLv))
srfs_forAllLv = list(map(lambda x: list(makeSrf_btwnFrame(*x)), pairFrames_forAllLv))

srfs_forAllSide

OUT = srfs_forAllLv
# ----------------------------------------
전층_경간면_내부_등분선_찾기_col = Python(IN[0]=concave_hull, IN[1]=전입면_경간_면_생성_col)  # CPython3; same code as 전층_경간면_내부_등분선_찾기
element_별_하중srf_할당_col = Python(IN[1]=전층_경간면_내부_등분선_찾기_col, IN[2]=code_block_13)  # CPython3; unwired: IN[0]; same code as element_별_하중srf_할당_frame
byGeometry = BoundingBox.ByGeometry()  # unwired: geom
콘크리트_강도_선택 = IntegerSlider(1, range=0..40 step 1)  # graph input
code_block_25 = CodeBlock(i=toDict_allBeams) { i["lvBelong"]; }
uniqueItems = List.UniqueItems(list=code_block_25)
code_block_26 = CodeBlock(i=하중_값_계산) { i["startNode"]["name"]; }
uniqueItems_2 = List.UniqueItems(list=code_block_26@L2)
file_path = Filename("..\..\etc\_팀교육\StrToolkit\frame_json_sample_modif.txt")
flatten_3 = List.Flatten(list=하중_값_계산)
toDict_allCols = Python(IN[0]=allCols, IN[1]=getLevelsDict, IN[2]=longAxis, IN[3]=shortAxis, IN[4]=탄성계수)  # CPython3
# ---------- toDict_allCols.python (183 lines) ----------
# Load the Python Standard and DesignScript Libraries
import sys
import clr
clr.AddReference('ProtoGeometry')
from Autodesk.DesignScript.Geometry import *

################Module For Functional Programing#########################
from functools import reduce; from itertools import chain
from itertools import groupby; import operator
from copy import deepcopy
curry = lambda f: lambda a,*args: f(a, *args) if (len(args)) else lambda *args: f(a, *args)

filter, map, reduce = curry(filter), curry(map), curry(reduce)

go = lambda *args: reduce(lambda a,f: f(a), args) ## 함수도 축약 가능 ##

def dictUpdate(dic1,dic2):
    dic1.update(dic2)
    return dic1
    
def dictsMerge(dics):
    res = reduce(dictUpdate, dics)
    return res
    
def dictDeleteKeys(dic, keys):
    for k in keys:
        del dic[k]
    return dic

def flat(a):
    if isinstance(a, list):
        for i in a: 
            yield from flat(i)
    else: yield a

def grpBy(iter, key):
    f,keys,grps = key,[],[]
    sorted_ = sorted(iter, key=f)
    for key, grp_data in groupby(sorted_,key=f):
        keys.append(key); grps.append(list(grp_data))
    return grps,keys
#########################################################################
# The inputs to this node will be stored as a list in the IN variables.
dataEnteringNode = IN
allLvsDict = IN[1]
allCols = IN[0]
frameNoDict = IN[2]
shortAxisNoDict = IN[3]
input_E = IN[4]
# Place your code below this line
def get_BuilingBdBox(allCols):
    allCols_loc = list(map(lambda x: x.GetLocation(),allCols))
    bdBox = BoundingBox.ByGeometry(allCols_loc).ToCuboid()
    return bdBox

def getSideDict(allCols):
    allCols_loc = list(map(lambda x: x.GetLocation(),allCols))
    bdBoxFaces = get_BuilingBdBox(allCols).Explode()
    sideFaces = go(
        bdBoxFaces,
        filter(lambda x: x.NormalAtParameter(0.5,0.5).Z == 0),
        list,
    )
    resDict = go(
        ["south","west","north","east"],
        lambda x: zip(x, sideFaces),
        dict,
    )
    
    return resDict

def toDict_allCols(allCols, frameNoDict, allLvsDict):

    def find_Ix(elem):
        _tw = elem.GetParameterValueByName("Family and Type")\
            .GetParameterValueByName("Web Thickness") * 10
        _tf = elem.GetParameterValueByName("Family and Type")\
            .GetParameterValueByName("Flange Thickness") * 10
        _h = elem.GetParameterValueByName("Family and Type")\
            .GetParameterValueByName("Height") * 10
        _bf = elem.GetParameterValueByName("Family and Type")\
            .GetParameterValueByName("Width") * 10
        
        Ix = (2*(_bf*_tf**3/12+_bf*_tf*((_h-2*_tf)/2+_tf/2)**2)+_tw*(_h-2*_tf)**3/12)
        Ix_revit = elem.GetParameterValueByName("Family and Type")\
            .GetParameterValueByName("Moment of Inertia strong axis") * 10**4
        return Ix_revit

    def find_numberNameByElem(elem, nameDict, axis):
        tgtDict = {
            "X": elem.GetLocation().StartPoint.X,
            "Y": elem.GetLocation().StartPoint.Y,
            "Z": elem.GetLocation().StartPoint.Z,
        }
        res = []
        tgt = tgtDict[axis]
        for k,v in list(nameDict.items()):
            if v == tgt:
                res.append(k)
        return res

    def find_numberNameByPt(pt, nameDict, axis):
        tgtDict = {
            "X": pt.X,
            "Y": pt.Y,
            "Z": pt.Z,
        }
        res = []
        tgt = tgtDict[axis]
        for k,v in list(nameDict.items()):
            if v == tgt:
                res.append(k)
        return res

    def find_nodeName(elem, frameNoDict, shortAxisNoDict, allLvsDict):
        sttPt = elem.GetLocation().StartPoint
        
        endPt = elem.GetLocation().EndPoint
        
        name_stt_X = find_numberNameByPt(sttPt, frameNoDict, "X")[0]
        name_stt_Y = find_numberNameByPt(sttPt, shortAxisNoDict, "Y")[0]
        name_stt_Z = find_numberNameByPt(sttPt, allLvsDict, "Z")[0]
        name_stt = "1" + name_stt_X + name_stt_Y + name_stt_Z
        
        sttNodeDict = dict([("name",name_stt), ("X",sttPt.X), ("Z",sttPt.Z)])
        
        name_end_X = find_numberNameByPt(endPt, frameNoDict, "X")[0]
        name_end_Y = find_numberNameByPt(endPt, shortAxisNoDict, "Y")[0]
        name_end_Z = find_numberNameByPt(endPt, allLvsDict, "Z")[0]
        name_end = "1" + name_end_X + name_end_Y + name_end_Z
        
        endNodeDict = dict([("name",name_end), ("X",endPt.X), ("Z",endPt.Z)])
        
        return sttNodeDict, endNodeDict

    sideDict = getSideDict(allCols)    
        
    def findSide(col, sideDict):
        res = []
        for k,v in list(sideDict.items()):
            if col.Geometry()[0].DoesIntersect(v):
                res.append(k)
        return res
    
    def convertElementName(elem, replaceIDX, replaceChar):
        element_name = list(find_nodeName(elem, frameNoDict, shortAxisNoDict, allLvsDict)[0]["name"])
        element_name[replaceIDX] = replaceChar
        element_name_modified = "".join(element_name)
        return element_name_modified
    
    resDict = go(
        allCols,
        map( lambda x: {
            "elem": x,
            "element_name": convertElementName(x, 0, "2"),
            "sectionProp":{
                "name": x.GetParameterValueByName("Type").GetParameterValueByName("Type Name"),
                "sectionRotating": x.GetParameterValueByName("Cross-Section Rotation"),
                "A": x.GetParameterValueByName("Family and Type")\
                .GetParameterValueByName("Section Area") * 10**2,
                "I": find_Ix(x),
                "E": input_E,
            },
            "GUID": x.GetParameterValueByName("IfcGUID"),
            "role": "Column",
            "location_line": x.GetLocation(),
            "startNode": find_nodeName(x, frameNoDict, shortAxisNoDict, allLvsDict)[0],
            "endNode": find_nodeName(x, frameNoDict, shortAxisNoDict, allLvsDict)[1],
            "planeDirection": "n/a",
            "length": x.GetLocation().Length,
            "asgned_srfs": [],
            "asgned_area": 0,
            "frameNo": find_numberNameByElem(x, frameNoDict, "X")[0],
            "lvBelong": find_numberNameByElem(x, allLvsDict, "Z")[0],
            "sideBelong": findSide(x, sideDict),
        } )
    )
    
    return resDict

res = toDict_allCols(allCols, frameNoDict, allLvsDict)
# Assign your output to the OUT variable.
OUT = res
# ----------------------------------------
code_block_27 = CodeBlock(allColDicts=toDict_allCols) { allColDicts; }
join = List.Join(list0=flatten_3, list1=code_block_27)
code_block_28 = CodeBlock { "elem"; "location_line"; "asgned_srfs"; }
removeKeys = DesignScript.Builtin.Dictionary.RemoveKeys(dictionary=join, keys=code_block_28.out0)
removeKeys_2 = DesignScript.Builtin.Dictionary.RemoveKeys(dictionary=removeKeys, keys=code_block_28.out1)
removeKeys_3 = DesignScript.Builtin.Dictionary.RemoveKeys(dictionary=removeKeys_2, keys=code_block_28.out2)
code_block_29 = CodeBlock(i=removeKeys_3) { i; }
code_block_30 = CodeBlock(i=code_block_29) { i["frameNo"]; }
groupByKey_3 = List.GroupByKey(list=code_block_29, keys=code_block_30)
stringifyJSON = Data.StringifyJSON(values=groupByKey_3.groups)
writeText = FileSystem.WriteText(filePath=file_path, text=stringifyJSON)  # frozen
code_block_31 = CodeBlock(i=groupByKey_3.groups) { i["element_name"]; }
code_block_32 = CodeBlock(i=toDict_allBeams) { i; }
code_block_33 = CodeBlock(i=code_block_32) { i["frameNo"]; }
groupByKey_4 = List.GroupByKey(list=code_block_32, keys=code_block_33)
code_block_34 = CodeBlock(i=groupByKey_4.groups) { i["elem"].Geometry(); }
count_2 = List.Count(list=code_block_34@L3)
code_block_35 = CodeBlock(i=code_block_34) { i[2]; }
code_block_36 = CodeBlock(i=하중_값_계산) { i[0][5]["elem"].Geometry(); }
count_3 = List.Count(list=groupByKey_3.groups@L2)
