# Dynamo graph [HSD kit]_하중분배_[1.0.7].dyn (Dynamo 2.16.1.2727)

# note: 소속 입면 정보도 딕셔너리 추가
# 외부기둥만(판별은 기둥 로케이션 라인 전체 바운딩 박스로)
# 내부기둥은 정보 없음으로
# Nside
# Eside
# Sside
# Wside

rooms_by_status = RoomsByStatus()
coreCenterBoundary = Room.CoreCenterBoundary(room=rooms_by_status.PlacedRooms)
byJoinedCurves = PolyCurve.ByJoinedCurves(curves=coreCenterBoundary)  # frozen
categories = Categories("OST_StructuralFraming")
all_elements_of_category = ElementsOfCategory(Category=categories)
code_block = CodeBlock { "Reference Level"; }
getParameterValueByName = Element.GetParameterValueByName(element=all_elements_of_category, parameterName=code_block)
parameters = Element.Parameters(element=rooms_by_status.PlacedRooms)
categories_2 = Categories("OST_StructuralColumns")
all_elements_of_category_2 = ElementsOfCategory(Category=categories_2)
제외단면 = StringInput("""W200xL200,
W300xL300""")

# group: 제외 단면 명 리스트 정리구간
code_block_2 = CodeBlock { ","; }
split = String.Split(string=제외단면, separator0=code_block_2)
code_block_3 = CodeBlock { "\n"; }
split_2 = String.Split(string=split, separator0=code_block_3)
flatten = List.Flatten(list=split_2)

filterAGCols = Python(IN[0]=all_elements_of_category_2, IN[1]=flatten)  # CPython3
# ---------- filterAGCols.python (59 lines) ----------
# Load the Python Standard and DesignScript Libraries
import sys
import clr
clr.AddReference('ProtoGeometry')
from Autodesk.DesignScript.Geometry import *

#################################Module For Functional Programing#############################################
from functools import reduce
curry = lambda f: lambda a,*args: f(a, *args) if (len(args)) else lambda *args: f(a, *args)

filter = curry(filter)
map = curry(map)

def _take(length, iter):
    res = []
    for a in iter:
        res.append(a)
        if len(res) == length:
            return res
        
take = curry(_take)
reduce = curry(reduce)

go = lambda *args: reduce(lambda a,f: f(a), args) ## 함수도 축약 가능 ##
##############################################################################################################

# The inputs to this node will be stored as a list in the IN variables.
dataEnteringNode = IN
cols = IN[0]
exceptionRules = IN[1]
# Place your code below this line

#def getColumnCrv(els,exceptionRule):
#    res = go\
#    (
#        els,
#        filter(lambda x: "UG PED" not in str(x.GetParameterValueByName("Family and Type"))),
#        filter(lambda x: exceptionRule not in str(x.GetParameterValueByName("Family and Type"))),
#    )
#    
#    return res

def getColumnCrv_(els,exceptionRules):
    defaultFiltering = go\
    (
        els,
        filter(lambda x: "UG PED" not in str(x.GetParameterValueByName("Family and Type"))),
        list,
    )
    
    res = defaultFiltering
    for r in exceptionRules:
        res = list(filter(lambda x: r not in str(x.GetParameterValueByName("Family and Type")), res))
    
    
    return res

# Assign your output to the OUT variable.
OUT = getColumnCrv_(cols,exceptionRules)
# ----------------------------------------
getColumnCrv = Python(IN[0]=filterAGCols)  # CPython3; frozen
# ---------- getColumnCrv.python (43 lines) ----------
# Load the Python Standard and DesignScript Libraries
import sys
import clr
clr.AddReference('ProtoGeometry')
from Autodesk.DesignScript.Geometry import *

#################################Module For Functional Programing#############################################
from functools import reduce
curry = lambda f: lambda a,*args: f(a, *args) if (len(args)) else lambda *args: f(a, *args)

filter = curry(filter)
map = curry(map)

def _take(length, iter):
    res = []
    for a in iter:
        res.append(a)
        if len(res) == length:
            return res
        
take = curry(_take)
reduce = curry(reduce)

go = lambda *args: reduce(lambda a,f: f(a), args) ## 함수도 축약 가능 ##
##############################################################################################################

# The inputs to this node will be stored as a list in the IN variables.
dataEnteringNode = IN
cols = IN[0]
# Place your code below this line

def getColumnCrv(el):
    sttPt = el.GetLocation()
    endPt = go\
    (
        el,
        lambda x: x.GetLocation(),
        lambda x: x.Translate(0,0, el.GetParameterValueByName("Length")),
    )
    
    return Line.ByStartPointEndPoint(sttPt,endPt)
# Assign your output to the OUT variable.
OUT = map(getColumnCrv,cols)
# ----------------------------------------
code_block_4 = CodeBlock()
# ---------- code_block_4.designscript (4 lines) ----------
// 1. case
// DL = 부재자중(메인부재 + 그레이팅 하중) + 유관부서 EL
// 2. case < -우선 구현
// DL = 각 층의 Floor 로드를 정해서 입력하는 방식
# ----------------------------------------
n3_c_wind_enclosure = CustomSelection("BD-Enclosed", items={BD-Enclosed: "BD-Enclosed", BD-Partially Enclosed: "BD-Partially Enclosed", BD-Open: "BD-Open", Shelter: "Shelter"})  # "3. c :: Wind_Enclosure Classification"
n3_b_wind_information_입력_대괄호_항목 = StringInput("""[Basic_Wind_Speed]:
» 33.34

[Exposur_Category]
» C

[Topographic_factor(Kzt)]
» 1.0""")  # "3. b :: Wind Information 입력 (대괄호 항목 다음줄에 입력)"
code_block_5 = CodeBlock { ":"; " "; "\n"; }
split_3 = String.Split(string=n3_b_wind_information_입력_대괄호_항목, separator0=code_block_5.out0, separator1=code_block_5.out1, separator2=code_block_5.out2)
input_제어기 = Python(IN[0]=split_3)  # CPython3
# ---------- input_제어기.python (28 lines) ----------
# Load the Python Standard and DesignScript Libraries
import sys
import clr
clr.AddReference('ProtoGeometry')
from Autodesk.DesignScript.Geometry import *

# The inputs to this node will be stored as a list in the IN variables.
dataEnteringNode = IN
inputStrs = IN[0]
# Place your code below this line
def strToint(i):
    try:
        res = float(i)
    except:
        res = i
    return res
inputDatas = map(strToint, inputStrs)

def dictInput(inputStrs):
    if inputStrs[0].startswith("["):
        inputPairs = list(map(lambda n: inputStrs[n:n+1+1], range(0,len(inputStrs),2)))
        res = dict(inputPairs)
    else:
        res = 0
    return res
    
# Assign your output to the OUT variable.
OUT = inputDatas
# ----------------------------------------
n4_a_seismic_code_선택 = CustomSelection("ASCE-7", items={ASCE-7: "ASCE-7", KDS 41 12 00: "KDS 41 12 00", EN 1991-1-1-4: "EN 1991-1-1-4"})  # "4. a :: Seismic_Code 선택"
n4_b_seismic_information_입력_대괄호 = StringInput("""[Site_Class]:
» 33.34

[Risk_Category]
» C

[Response_modification_factor_X]
» 3.0
[Response_modification_factor_Y]
» 3.0

[Spectral_acceleration_parameters_Sds]
» 0.091

[Spectral_acceleration_parameters_Sd1]
» 0.087""")  # "4. b :: Seismic Information 입력 (대괄호 항목 다음줄에 입력)"
concave_hull = Python()  # CPython3; unwired: IN[0]
# ---------- concave_hull.python (55 lines) ----------
# Load the Python Standard and DesignScript Libraries
import sys
import clr
clr.AddReference('ProtoGeometry')
from Autodesk.DesignScript.Geometry import *
from math import sqrt, hypot
from itertools import combinations
# The inputs to this node will be stored as a list in the IN variables.
dataEnteringNode = IN

# Place your code below this line
def concave_hull_(points, alpha):
    points = UnwrapElement(points)
    res = []
    
    pLen = len(points)
    alpha2 = alpha * alpha
    if pLen < 2:
        raise Exception('AlphaShape needs at least 2 points')

    for i, p in enumerate(points):
        for j in range(i+1, pLen):
            if p.IsAlmostEqualTo(points[j]):
                raise Exception('AlphaShape needs pairwise distinct points')
            dist = hypot(p.X - points[j].X, p.Y - points[j].Y)                    
            #if (dist > 2 * alpha) : continue #circle fits between points ==> p_i, p_j can't be alpha-exposed                    
    
            x1, y1, x2, y2 = p.X, p.Y, points[j].X, points[j].Y
            midX, midY = (x1 + x2) / 2, (y1 + y2) / 2
    
            #find two circles that contain p_i and p_j; note that center1 == center2 if dist == 2*alpha
            alphaDist = sqrt(alpha2 - (dist / 2) ** 2)
            #alphaDist = alpha2 - (dist / 2) ** 2
            deltaX, deltaY = (x2 - x1) / dist, (y1 - y2) / dist
            c1x, c1y = midX + alphaDist * deltaY, midY + alphaDist * deltaX
            c2x, c2y = midX - alphaDist * deltaY, midY - alphaDist * deltaX
            
            #check if one of the circles is alpha-exposed, i.e. no other point lies in it
            c1_empty = True 
            c2_empty = True
            for k in range(pLen):                
                if i == k or j == k: 
                    continue
                if ((c1x - points[k].X) * (c1x - points[k].X) + (c1y - points[k].Y) * (c1y - points[k].Y) < alpha2):
                    c1_empty = False
                if ((c2x - points[k].X) * (c2x - points[k].X) + (c2y - points[k].Y) * (c2y - points[k].Y) < alpha2):
                    c2_empty = False
                if not c1_empty and not c2_empty:
                    break
            if c1_empty or c2_empty:
                res.append(Line.ByStartPointEndPoint(p, points[j]))
                #res.append(c1_empty)
    return res
# Assign your output to the OUT variable.
OUT = concave_hull_
# ----------------------------------------
code_block_6 = CodeBlock(allBeams=all_elements_of_category) { allBeams; }
getLevelsDict = Python(IN[0]=all_elements_of_category)  # CPython3
# ---------- getLevelsDict.python (89 lines) ----------
# Load the Python Standard and DesignScript Libraries
import sys
import clr
clr.AddReference('ProtoGeometry')
from Autodesk.DesignScript.Geometry import *

################Module For Functional Programing#########################
from functools import reduce; from itertools import chain
from itertools import groupby; import operator
from copy import deepcopy
curry = lambda f: lambda a,*args: f(a, *args) if (len(args)) else lambda *args: f(a, *args)

filter, map, reduce = curry(filter), curry(map), curry(reduce)

go = lambda *args: reduce(lambda a,f: f(a), args) ## 함수도 축약 가능 ##

def dictUpdate(dic1,dic2):
    dic1.update(dic2)
    return dic1
    
def dictsMerge(dics):
    res = reduce(dictUpdate, dics)
    return res
    
def dictDeleteKeys(dic, keys):
    for k in keys:
        del dic[k]
    return dic

def flat(a):
    if isinstance(a, list):
        for i in a: 
            yield from flat(i)
    else: yield a

def grpBy(iter, key):
    f,keys,grps = key,[],[]
    sorted_ = sorted(iter, key=f)
    for key, grp_data in groupby(sorted_,key=f):
        keys.append(key); grps.append(list(grp_data))
    return grps,keys
#########################################################################
# The inputs to this node will be stored as a list in the IN variables.
dataEnteringNode = IN
allFrames = IN[0]
# Place your code below this line

def getAllFrameLvs(allFrames):
    allFrames_loc = list(map(lambda x: x.GetLocation(),allFrames))
    allFrameLvElevations = go(
        allFrames_loc,
        map(lambda x: x.StartPoint.Z),set,
        sorted,
    )
    return allFrameLvElevations

def getAllLvs(allFrames):
    allLvElevations = getAllFrameLvs(allFrames)
    if 0 in allLvElevations:
        res = allLvElevations
    elif 0 not in allLvElevations:
        res = [0] + allLvElevations
    
    return res

def index_toName(datas):
    rngsStr = list(map(str, range(len(datas))))
    allNames = go(
        rngsStr,
        map(lambda x: "0" + x if len(x) < 2 else x)
    )
    return allNames

def getLevelsDict(allFrames):
    allFrames_loc = list(map(lambda x: x.GetLocation(), allFrames))
    allLvElevations = getAllLvs(allFrames)
    
    lvNames = index_toName(allLvElevations)
    
    resDict = go(
        zip(lvNames, allLvElevations),
        dict,
    )
    
    return resDict

res = getLevelsDict(allFrames)
# Assign your output to the OUT variable.
OUT = res
# ----------------------------------------
categories_3 = Categories("OST_StructuralColumns")
all_elements_of_category_3 = ElementsOfCategory(Category=categories_3)
allCols = CodeBlock(allCols=all_elements_of_category_3) { allCols; }
find_longitudinalaxis_건물의_장축방향 = Python(IN[0]=allCols)  # "find_longitudinalAxis(건물의 장축방향 벡터)"; CPython3
# ---------- find_longitudinalaxis_건물의_장축방향.python (85 lines) ----------
# Load the Python Standard and DesignScript Libraries
import sys
import clr
clr.AddReference('ProtoGeometry')
from Autodesk.DesignScript.Geometry import *

################Module For Functional Programing#########################
from functools import reduce; from itertools import chain
from itertools import groupby; import operator
from copy import deepcopy
curry = lambda f: lambda a,*args: f(a, *args) if (len(args)) else lambda *args: f(a, *args)

filter, map, reduce = curry(filter), curry(map), curry(reduce)

go = lambda *args: reduce(lambda a,f: f(a), args) ## 함수도 축약 가능 ##

def dictUpdate(dic1,dic2):
    dic1.update(dic2)
    return dic1
    
def dictsMerge(dics):
    res = reduce(dictUpdate, dics)
    return res
    
def dictDeleteKeys(dic, keys):
    for k in keys:
        del dic[k]
    return dic

def flat(a):
    if isinstance(a, list):
        for i in a: 
            yield from flat(i)
    else: yield a

def grpBy(iter, key):
    f,keys,grps = key,[],[]
    sorted_ = sorted(iter, key=f)
    for key, grp_data in groupby(sorted_,key=f):
        keys.append(key); grps.append(list(grp_data))
    return grps,keys
#########################################################################
# The inputs to this node will be stored as a list in the IN variables.
dataEnteringNode = IN
allCols = IN[0]
# Place your code below this line
def index_toName(datas):
    rngsStr = list(map(str, range(len(datas))))
    allNames = go(
        rngsStr,
        map(lambda x: "0" + x if len(x) < 2 else x)
    )
    return allNames
    
def get_BuilingBdBox(allCols):
    allCols_loc = list(map(lambda x: x.GetLocation(),allCols))
    bdBox = BoundingBox.ByGeometry(allCols_loc).ToCuboid()
    return bdBox

def find_longitudinalAxis(allCols):
    bdBox = get_BuilingBdBox(allCols)
    btmFace_PeriLine = go(
        bdBox,
        lambda x: x.Explode(),
        filter(lambda x: x.NormalAtParameter(0.5,0.5).Z == -1),
        list, lambda x: x[0],
        lambda x: x.PerimeterCurves(),
    )
    longitudinalVec = go(
        btmFace_PeriLine,
        map(lambda x: x.Length), max,
        lambda x: filter(lambda y: y.Length == x, btmFace_PeriLine),
        list,lambda x:x[0],
        lambda x: x.Direction.Normalized(),
    )
    if longitudinalVec.X < 0 or longitudinalVec.Y < 0:
        longitudinalVec = longitudinalVec.Reverse()
    else:
        pass
    
    return longitudinalVec

res = find_longitudinalAxis(allCols)
# Assign your output to the OUT variable.
OUT = res
# ----------------------------------------
get_framenodict_장축방향 = Python(IN[0]=allCols, IN[1]=find_longitudinalaxis_건물의_장축방향)  # CPython3
# ---------- get_framenodict_장축방향.python (83 lines) ----------
# Load the Python Standard and DesignScript Libraries
import sys
import clr
clr.AddReference('ProtoGeometry')
from Autodesk.DesignScript.Geometry import *

################Module For Functional Programing#########################
from functools import reduce; from itertools import chain
from itertools import groupby; import operator
from copy import deepcopy
curry = lambda f: lambda a,*args: f(a, *args) if (len(args)) else lambda *args: f(a, *args)

filter, map, reduce = curry(filter), curry(map), curry(reduce)

go = lambda *args: reduce(lambda a,f: f(a), args) ## 함수도 축약 가능 ##

def dictUpdate(dic1,dic2):
    dic1.update(dic2)
    return dic1
    
def dictsMerge(dics):
    res = reduce(dictUpdate, dics)
    return res
    
def dictDeleteKeys(dic, keys):
    for k in keys:
        del dic[k]
    return dic

def flat(a):
    if isinstance(a, list):
        for i in a: 
            yield from flat(i)
    else: yield a

def grpBy(iter, key):
    f,keys,grps = key,[],[]
    sorted_ = sorted(iter, key=f)
    for key, grp_data in groupby(sorted_,key=f):
        keys.append(key); grps.append(list(grp_data))
    return grps,keys
#########################################################################
# The inputs to this node will be stored as a list in the IN variables.
dataEnteringNode = IN
allCols = IN[0]
bdLongiVec = IN[1]
# Place your code below this line
def index_toName(datas):
    rngsStr = list(map(str, range(len(datas))))
    allNames = go(
        rngsStr,
        map(lambda x: "0" + x if len(x) < 2 else x)
    )
    return allNames
    
def get_SpansDict(allCols, bdLongiVec):
    xSpans = go(
        allCols,
        lambda x: grpBy(x, lambda x: x.GetLocation().StartPoint.X)[1],
        sorted,list
    )
    ySpans = go(
        allCols,
        lambda x: grpBy(x, lambda x: x.GetLocation().StartPoint.Y)[1],
        sorted,list
    )
    
    if bdLongiVec.IsParallel(Vector.XAxis()):
        spans = xSpans
    elif bdLongiVec.IsParallel(Vector.YAxis()):
        spans = ySpans
    
    spanNames = index_toName(spans)
    resDict = go(
        zip(spanNames, spans),
        dict,
    )
    return resDict


res = get_SpansDict(allCols, bdLongiVec), get_SpansDict(allCols, bdLongiVec.Rotate(Vector.ZAxis(), 90) )
# Assign your output to the OUT variable.
OUT = res
# ----------------------------------------
longAxis = CodeBlock(i=get_framenodict_장축방향) { i[0]; }
shortAxis = CodeBlock(i=get_framenodict_장축방향) { i[1]; }
allCols_2 = CodeBlock(allCols=allCols) { allCols; }
탄성계수 = CodeBlock { 210000; }
toDict_allBeams = Python(IN[0]=code_block_6, IN[1]=getLevelsDict, IN[2]=longAxis, IN[3]=shortAxis, IN[4]=allCols_2, IN[5]=탄성계수)  # CPython3
# ---------- toDict_allBeams.python (194 lines) ----------
# Load the Python Standard and DesignScript Libraries
import sys
import clr
clr.AddReference('ProtoGeometry')
from Autodesk.DesignScript.Geometry import *

################Module For Functional Programing#########################
from functools import reduce; from itertools import chain
from itertools import groupby; import operator
from copy import deepcopy
curry = lambda f: lambda a,*args: f(a, *args) if (len(args)) else lambda *args: f(a, *args)

filter, map, reduce = curry(filter), curry(map), curry(reduce)

go = lambda *args: reduce(lambda a,f: f(a), args) ## 함수도 축약 가능 ##

def dictUpdate(dic1,dic2):
    dic1.update(dic2)
    return dic1
    
def dictsMerge(dics):
    res = reduce(dictUpdate, dics)
    return res
    
def dictDeleteKeys(dic, keys):
    for k in keys:
        del dic[k]
    return dic

def flat(a):
    if isinstance(a, list):
        for i in a: 
            yield from flat(i)
    else: yield a

def grpBy(iter, key):
    f,keys,grps = key,[],[]
    sorted_ = sorted(iter, key=f)
    for key, grp_data in groupby(sorted_,key=f):
        keys.append(key); grps.append(list(grp_data))
    return grps,keys
#########################################################################
# The inputs to this node will be stored as a list in the IN variables.
dataEnteringNode = IN
allLvsDict = IN[1]
allBeams = IN[0]
frameNoDict = IN[2]
shortAxisNoDict = IN[3]
allCols = IN[4]
input_E = IN[5]
# Place your code below this line
def chck_intsctWithCols(frame, allColsGeo):
    frameLocation = frame\
                    .GetLocation()\
                    .ExtendStart(500)\
                    .ExtendEnd(500)
    res = frameLocation.DoesIntersect(allColsGeo)
    
    return res

def filter_allGirders(allBeamsDicts, allCols):
    allColsGeo = go(
        allCols,
        map(lambda x: x.Geometry()[0]),list,
        Solid.ByUnion,
    )
    res = go(
        allBeamsDicts,list,
        filter(lambda x: chck_intsctWithCols(x, allColsGeo)),
        list,
    )
    return res



def toDict_allGirders(allGirders, frameNoDict, allLvsDict, shortAxisNoDict, input_E):
    
    def find_Ix(elem):
        _tw = elem.GetParameterValueByName("Family and Type")\
            .GetParameterValueByName("Web Thickness") * 10
        _tf = elem.GetParameterValueByName("Family and Type")\
            .GetParameterValueByName("Flange Thickness") * 10
        _h = elem.GetParameterValueByName("Family and Type")\
            .GetParameterValueByName("Height") * 10
        _bf = elem.GetParameterValueByName("Family and Type")\
            .GetParameterValueByName("Width") * 10
        
        Ix = (2*(_bf*_tf**3/12+_bf*_tf*((_h-2*_tf)/2+_tf/2)**2)+_tw*(_h-2*_tf)**3/12)
        Ix_revit = elem.GetParameterValueByName("Family and Type")\
            .GetParameterValueByName("Moment of Inertia strong axis") * 10**4
        return Ix_revit
    
    def find_numberNameByElem(elem, nameDict, axis):
        tgtDict = {
            "X": elem.GetLocation().StartPoint.X,
            "Y": elem.GetLocation().StartPoint.Y,
            "Z": elem.GetLocation().StartPoint.Z,
        }
        res = []
        tgt = tgtDict[axis]
        for k,v in list(nameDict.items()):
            if v == tgt:
                res.append(k)
        return res

    def find_numberNameByPt(pt, nameDict, axis):
        tgtDict = {
            "X": pt.X,
            "Y": pt.Y,
            "Z": pt.Z,
        }
        res = []
        tgt = tgtDict[axis]
        for k,v in list(nameDict.items()):
            if v == tgt:
                res.append(k)
        return res

    def find_nodeName(elem, frameNoDict, shortAxisNoDict, allLvsDict):
        sttPt = elem.GetLocation().StartPoint
        
        endPt = elem.GetLocation().EndPoint
        
        name_stt_X = find_numberNameByPt(sttPt, frameNoDict, "X")[0]
        name_stt_Y = find_numberNameByPt(sttPt, shortAxisNoDict, "Y")[0]
        name_stt_Z = find_numberNameByPt(sttPt, allLvsDict, "Z")[0]
        name_stt = "1" + name_stt_X + name_stt_Y + name_stt_Z
        
        sttNodeDict = dict([("name",name_stt), ("Y",sttPt.Y), ("Z",sttPt.Z)])
        
        name_end_X = find_numberNameByPt(endPt, frameNoDict, "X")[0]
        name_end_Y = find_numberNameByPt(endPt, shortAxisNoDict, "Y")[0]
        name_end_Z = find_numberNameByPt(endPt, allLvsDict, "Z")[0]
        name_end = "1" + name_end_X + name_end_Y + name_end_Z
        
        endNodeDict = dict([("name",name_end), ("Y",endPt.Y), ("Z",endPt.Z)])
        
        return sttNodeDict, endNodeDict
        
    def find_elemDirection(line):
        lineVector = line.Direction.Normalized()
        if abs(lineVector.X) > 0:
            res = "longAxis"
        elif abs(lineVector.Y) > 0:
            res = "shortAxis"
        return res

    def convertElementName(elem, replaceIDX, replaceChar):
        element_name = list(find_nodeName(elem, frameNoDict, shortAxisNoDict, allLvsDict)[0]["name"])
        element_name[replaceIDX] = replaceChar
        element_name_modified = "".join(element_name)
        return element_name_modified

    resDict = go(
        allGirders,
        map( lambda x: {
            "elem": x,
            "element_name": convertElementName(x, 0, "3"),
            "sectionProp":{
                "name": x.GetParameterValueByName("Type").GetParameterValueByName("Type Name"),
                "sectionRotating": x.GetParameterValueByName("Cross-Section Rotation"),
                "A": x.GetParameterValueByName("Family and Type")\
                .GetParameterValueByName("Section Area") * 10**2,
                "I": find_Ix(x),
                "E": input_E,
            },
            "GUID": x.GetParameterValueByName("IfcGUID"),
            "role": "Girders",
            "location_line": x.GetLocation(),
            # 노드 추가
            "startNode": find_nodeName(x, frameNoDict, shortAxisNoDict, allLvsDict)[0],
            "endNode": find_nodeName(x, frameNoDict, shortAxisNoDict, allLvsDict)[1],
            "planeDirection": find_elemDirection(x.GetLocation()),
            "length": x.GetLocation().Length,
            "asgned_srfs": [],
            "asgned_area": 0,
            "frameNo": find_numberNameByElem(x, frameNoDict, "X")[0],
            "lvBelong": find_numberNameByElem(x, allLvsDict, "Z")[0],
            "sideBelong": [] ,
        } )
    )
    return resDict

#allBeamsDicts = toDict_allBeams(allBeams, frameNoDict, allLvsDict)
allGirders = filter_allGirders(allBeams, allCols)

allGirdersDicts = toDict_allGirders(allGirders, frameNoDict, allLvsDict, shortAxisNoDict, input_E)

#allGirdersDicts_X = list(filter(lambda x: x["planeDirection"]=="shortAxis", allGirdersDicts))

res = allGirdersDicts

# Assign your output to the OUT variable.
OUT = res
# ----------------------------------------
code_block_7 = CodeBlock(i=toDict_allBeams) { List.GroupByKey(i["elem"], i["elem"].GetParameterValueByName("Reference Level Elevation"))["groups"]; }
# note: boundary 없는 부재는 아예 노드 속성에 boundary 키가 없도록
전층_경간_면_생성 = Python(IN[0]=concave_hull, IN[1]=code_block_7)  # CPython3
# ---------- 전층_경간_면_생성.python (144 lines) ----------
# Load the Python Standard and DesignScript Libraries
import sys
import clr
clr.AddReference('ProtoGeometry')
from Autodesk.DesignScript.Geometry import *
from Autodesk.DesignScript.Geometry import Line

from math import sqrt, hypot
from itertools import combinations
################Module For Functional Programing#########################
from functools import reduce; from itertools import chain
from itertools import groupby; import operator
from copy import deepcopy
curry = lambda f: lambda a,*args: f(a, *args) if (len(args)) else lambda *args: f(a, *args)

filter, map, reduce = curry(filter), curry(map), curry(reduce)

go = lambda *args: reduce(lambda a,f: f(a), args) ## 함수도 축약 가능 ##

def dictUpdate(dic1,dic2):
    dic1.update(dic2)
    return dic1
    
def dictsMerge(dics):
    res = reduce(dictUpdate, dics)
    return res
    
def dictDeleteKeys(dic, keys):
    for k in keys:
        del dic[k]
    return dic

def flat(a):
    if isinstance(a, list):
        for i in a: 
            yield from flat(i)
    else: yield a

def grpBy(iter, key):
    f,keys,grps = key,[],[]
    sorted_ = sorted(iter, key=f)
    for key, grp_data in groupby(sorted_,key=f):
        keys.append(key); grps.append(list(grp_data))
    return grps,keys
#########################################################################
    
# The inputs to this node will be stored as a list in the IN variables.
dataEnteringNode = IN
concave_hull = IN[0]
#loadPerLevel = IN[1]
elems_forAllLv = IN[1]
#gridsX, gridsY = grids

# Place your code below this line


def grp_XYbeamsLinesPerLv(elemsPerLv):
    allLines = go(
        elemsPerLv,
        map(lambda x: x.GetLocation()),
        list,
    )
    directionsPerLevel = go(
        allLines,
        map(lambda x: x.Direction),
        map(lambda x: x.Normalized()),
        list,
    )
    
    isParallel = lambda e: go(
        e,
        lambda x: x.Direction,
        lambda x: x.Normalized(),
        lambda x: not x.IsParallel(directionsPerLevel[0]),
    )
    
    
    return grpBy(allLines, isParallel)[0]

def make_pairFrames(xGrps, yGrps):
    pairX = go(
        xGrps,
        lambda x: sorted(x, key=lambda e: e.StartPoint.X),
        lambda x: grpBy(x, key=lambda e: e.StartPoint.X)[0],
        map(lambda x: sorted(x, key=lambda e: e.StartPoint.Y)),
        #2개씩 1간격으로 서브리스트 생성
        map(lambda x: list(map(lambda n: x[n:n+1+1], range(len(x))[:-1]))),
        lambda x: list(chain(*x)),
    )
    pairY = go(
        yGrps,
        lambda x: sorted(x, key=lambda e: e.StartPoint.X),
        lambda x: grpBy(x, key=lambda e: e.StartPoint.X)[0],
        map(lambda x: sorted(x, key=lambda e: e.StartPoint.Y)),list,
        #2개씩 1간격으로 서브리스트 생성
        lambda x: list(map(lambda n: x[n:n+1+1], range(len(x))[:-1])),
        # 서브리스트 구조 Transpose
        map(lambda x: list(zip(*chain(x)))),
        lambda x: list(chain(*x)),
    )
    return pairX, pairY

def get_IntersectInGrp(xGrp, yGrp):
    res = []
    for x in xGrp:
        for y in yGrp:
            res.append(x.Intersect(y))
    return list(chain(*res))

def GetBoundingSrfs(intscts):
    res = []
    try:
        crvSet = concave_hull(intscts, 100000)
        polyCrv = PolyCurve.ByJoinedCurves(crvSet)
        srf = Surface.ByPatch(polyCrv)
        srfThick = srf.Thicken(10,False)
#        bdCube = BoundingBox.ByGeometry(srfThick).ToCuboid()
#        bdCubeSrfs = bdCube.Explode()
#        bdBelowSrf = go(
#            bdCube.Explode(),
#            #bdCubeSrfs,
#            filter(lambda x: x.NormalAtParameter(0.5,0.5).Z != 0),
#            list,
#        )[0]
        return srf
    except: pass

def makeSrf_btwnFrame(xGrps, yGrps):
    res = []
    for xGrp in xGrps:
        for yGrp in yGrps:
            intscts = get_IntersectInGrp(xGrp, yGrp)
            if GetBoundingSrfs(intscts):
                res.append(GetBoundingSrfs(intscts))

    return res


# Assign your output to the OUT variable.
XY_elems_forAllLv = list(map(grp_XYbeamsLinesPerLv, elems_forAllLv))
pairFrames_forAllLv = list(map(lambda x: list(make_pairFrames(*x)), XY_elems_forAllLv))
srfs_forAllLv = list(map(lambda x: list(makeSrf_btwnFrame(*x)), pairFrames_forAllLv))

OUT = srfs_forAllLv
# ----------------------------------------
전층_경간면_내부_등분선_찾기 = Python(IN[0]=concave_hull, IN[1]=전층_경간_면_생성)  # CPython3
# ---------- 전층_경간면_내부_등분선_찾기.python (168 lines) ----------
# Load the Python Standard and DesignScript Libraries
import sys
import clr
clr.AddReference('ProtoGeometry')
from Autodesk.DesignScript.Geometry import *

################Module For Functional Programing#########################
from functools import reduce; from itertools import chain
from itertools import groupby; import operator
from copy import deepcopy
curry = lambda f: lambda a,*args: f(a, *args) if (len(args)) else lambda *args: f(a, *args)

filter, map, reduce = curry(filter), curry(map), curry(reduce)

go = lambda *args: reduce(lambda a,f: f(a), args) ## 함수도 축약 가능 ##

def dictUpdate(dic1,dic2):
    dic1.update(dic2)
    return dic1
    
def dictsMerge(dics):
    res = reduce(dictUpdate, dics)
    return res
    
def dictDeleteKeys(dic, keys):
    for k in keys:
        del dic[k]
    return dic

def flat(a):
    if isinstance(a, list):
        for i in a: 
            yield from flat(i)
    else: yield a

def grpBy(iter, key):
    f,keys,grps = key,[],[]
    sorted_ = sorted(iter, key=f)
    for key, grp_data in groupby(sorted_,key=f):
        keys.append(key); grps.append(list(grp_data))
    return grps,keys
#########################################################################


# The inputs to this node will be stored as a list in the IN variables.
dataEnteringNode = IN
concave_hull = IN[0]
srfs_forAllLv = IN[1]
# Place your code below this line

def find_allCorner(srf):
    u_stt = srf.PointAtParameter(0,1)
    u_end = srf.PointAtParameter(1,1)
    b_stt = srf.PointAtParameter(0,0)
    b_end = srf.PointAtParameter(1,0)
    
    return u_stt, u_end, b_stt, b_end

def find_shortSide(srf):
    u_stt, u_end, b_stt, b_end = find_allCorner(srf)
    u_shortSide = Line.ByStartPointEndPoint(u_stt, u_end)
    b_shortSide = Line.ByStartPointEndPoint(b_stt, b_end)
    
    return u_shortSide, b_shortSide
    
def find_longSide(srf):
    u_stt, u_end, b_stt, b_end = find_allCorner(srf)
    l_longSide = Line.ByStartPointEndPoint(u_stt, b_stt)
    r_longSide = Line.ByStartPointEndPoint(u_end, b_end)
    
    return l_longSide, r_longSide
    
def find_longSide_midLine(srf):
    u_shortSide, b_shortSide = find_shortSide(srf)
    u_midPt = u_shortSide.PointAtParameter(0.5)
    b_midPt = b_shortSide.PointAtParameter(0.5)
    midLine = Line.ByStartPointEndPoint(u_midPt, b_midPt)
    
    return midLine

def find_2wayRefPts(srf):
    u_shortSide, b_shortSide = find_shortSide(srf)
    shortSideLength = u_shortSide.Length
    u_midPt = u_shortSide.PointAtParameter(0.5)
    b_midPt = b_shortSide.PointAtParameter(0.5)
    midLine = find_longSide_midLine(srf)
    midLineVec = midLine.Direction
    srfNormalVec = srf.NormalAtParameter(0.5,0.5)
    
    u_circle = Circle.ByCenterPointRadiusNormal(u_midPt, shortSideLength/2, srfNormalVec)
    b_circle = Circle.ByCenterPointRadiusNormal(b_midPt, shortSideLength/2, srfNormalVec)
    u_45d_pt = midLine.Intersect(u_circle)[0]
    b_45d_pt = midLine.Intersect(b_circle)[0]
    
    return u_45d_pt, b_45d_pt

def div_srf_1way(srf):
    u_stt, u_end, b_stt, b_end = find_allCorner(srf)
    u_shortSide, b_shortSide = find_shortSide(srf)
    u_midPt = u_shortSide.PointAtParameter(0.5)
    b_midPt = b_shortSide.PointAtParameter(0.5)
    
    l_srf = go(
        [u_stt, b_stt, u_midPt, b_midPt],
        lambda x: concave_hull(x, 100000),
        PolyCurve.ByJoinedCurves,
        Surface.ByPatch,
    )
    r_srf = go(
        [u_end, b_end, u_midPt, b_midPt],
        lambda x: concave_hull(x, 100000),
        PolyCurve.ByJoinedCurves,
        Surface.ByPatch,
    )
    
    return l_srf, r_srf

def div_srf_2way(srf):
    u_stt, u_end, b_stt, b_end = find_allCorner(srf)
    u_45d_pt, b_45d_pt = find_2wayRefPts(srf)
    
    l_srf = go(
        [u_stt, b_stt, u_45d_pt, b_45d_pt],
        #lambda x: concave_hull(x, 100000),  ## concave_hull 에서 근접점 오류 발생
        Polygon.ByPoints,
        PolyCurve.ByJoinedCurves,
        Surface.ByPatch,
    )
#    r_srf = go(
#        [u_end, b_end, u_45d_pt, b_45d_pt],
#        lambda x: concave_hull(x, 100000),
#        PolyCurve.ByJoinedCurves,
#        Surface.ByPatch,
#    )
#    u_srf =  go(
#        [u_stt, u_end, u_45d_pt],
#        lambda x: concave_hull(x, 100000),
#        PolyCurve.ByJoinedCurves,
#        Surface.ByPatch,
#    )
#    b_srf = go(
#        [b_stt, b_end, b_45d_pt],
#        lambda x: concave_hull(x, 100000),
#        PolyCurve.ByJoinedCurves,
#        Surface.ByPatch,
#    )
    
    return l_srf, r_srf, u_srf, b_srf

def div_srf(srf):
    u_stt, u_end, b_stt, b_end = find_allCorner(srf)
    shortSide = find_shortSide(srf)[0].Length
    longSide = find_longSide(srf)[0].Length
    ratio = longSide/shortSide
    
    if ratio < 2:
        #res = [{"srf": x, "load_path": "2way"} for x in div_srf_2way(srf)] ## srfDict 형태로 반환
        res = [{"srf": x, "load_path": "1way"} for x in div_srf_1way(srf)]
    elif ratio >= 2:
        res = [{"srf": x, "load_path": "1way"} for x in div_srf_1way(srf)]
    
    return res

def div_srf_perLv(srfsPerLv):
    return list(chain(*map(div_srf, srfsPerLv)))

# Assign your output to the OUT variable.
OUT = map(div_srf_perLv, srfs_forAllLv)
# ----------------------------------------
code_block_8 = CodeBlock(i=toDict_allBeams) { i; }
element_별_하중srf_할당_frame = Python(IN[1]=전층_경간면_내부_등분선_찾기, IN[2]=code_block_8)  # CPython3; unwired: IN[0]
# ---------- element_별_하중srf_할당_frame.python (100 lines) ----------
# Load the Python Standard and DesignScript Libraries
import sys
import clr
clr.AddReference('ProtoGeometry')
from Autodesk.DesignScript.Geometry import *

################Module For Functional Programing#########################
from functools import reduce; from itertools import chain
from itertools import groupby; import operator
from copy import deepcopy
curry = lambda f: lambda a,*args: f(a, *args) if (len(args)) else lambda *args: f(a, *args)

filter, map, reduce = curry(filter), curry(map), curry(reduce)

go = lambda *args: reduce(lambda a,f: f(a), args) ## 함수도 축약 가능 ##

def dictUpdate(dic1,dic2):
    dic1.update(dic2)
    return dic1
    
def dictsMerge(dics):
    res = reduce(dictUpdate, dics)
    return res
    
def dictDeleteKeys(dic, keys):
    for k in keys:
        del dic[k]
    return dic

def flat(a):
    if isinstance(a, list):
        for i in a: 
            yield from flat(i)
    else: yield a

def grpBy(iter, key):
    f,keys,grps = key,[],[]
    sorted_ = sorted(iter, key=f)
    for key, grp_data in groupby(sorted_,key=f):
        keys.append(key); grps.append(list(grp_data))
    return grps,keys
#########################################################################

# The inputs to this node will be stored as a list in the IN variables.
dataEnteringNode = IN
srfs_forAllLv = IN[1]
#elems_forAllLv = IN[2]
elemDicts = IN[2]
elemDicts_forAllLv = go(
    elemDicts,
    lambda x: grpBy(x, lambda e: e["elem"].GetParameterValueByName("Reference Level Elevation")),
    lambda x: x[0]
)
# Place your code below this line
elemDictsX_forAllLv = go(
    elemDicts_forAllLv,
    map(lambda x: grpBy(x, lambda d: d["planeDirection"])[0]),
    map(lambda x: x[1]),list,
)

elemDictsY_forAllLv = go(
    elemDicts_forAllLv,
    map(lambda x: grpBy(x, lambda d: d["planeDirection"])[0]),
    map(lambda x: x[1]),list,
)

def find_intsctSrfs(elemDict, srfs_perLv):
    
    elemLineforChck = elemDict["elem"]\
                        .GetLocation()\
                        .ExtendStart(-100)\
                        .ExtendEnd(-100)
    assignedSrfs = go(
        srfs_perLv,
        filter(lambda x: x["load_path"]=="1way"),
        filter(lambda x: elemLineforChck.DoesIntersect(x["srf"])),
        list,
    )
    elemDict["asgned_srfs"] = list(map(lambda x: x["srf"], assignedSrfs))
    elemDict["asgned_area"] = round(sum(list(map(lambda x: x["srf"].Area, assignedSrfs))),2)
    
    return elemDict


def find_intsctSrfsPerLv(elemDictsPerLv, srfs_perLv):
    res = go(
        elemDictsPerLv,
        map(lambda x: find_intsctSrfs(x, srfs_perLv)),
        list
    )
    return res

res = go(
    elemDictsX_forAllLv,
    lambda x: list(zip(x, srfs_forAllLv)),
    map(lambda x: find_intsctSrfsPerLv(*x)),
)

# Assign your output to the OUT variable.
OUT = res
# ----------------------------------------
n0_실행모드 = CustomSelection("하중분배모드", items={입력모드: "입력모드", 하중분배모드: "하중분배모드"})  # "0. 실행모드"; graph input
code_block_9 = CodeBlock(mode=n0_실행모드) { mode; }

# group: Read Load Inform from Json
download폴더_경로 = Python()  # CPython3; unwired: IN[0]
# ---------- download폴더_경로.python (15 lines) ----------
# Load the Python Standard and DesignScript Libraries
import sys
import clr
clr.AddReference('ProtoGeometry')
from Autodesk.DesignScript.Geometry import *
import os
# The inputs to this node will be stored as a list in the IN variables.
dataEnteringNode = IN

# Place your code below this line
def find_downloadPath():
    download = os.path.join(os.path.expanduser('~'), 'downloads')
    return download
# Assign your output to the OUT variable.
OUT = find_downloadPath()
# ----------------------------------------
directory_from_path = DirectoryObject(path=download폴더_경로)
getDirectoryContents = FileSystem.GetDirectoryContents(directory=directory_from_path)
code_block_10 = CodeBlock()
# ---------- code_block_10.designscript (6 lines) ----------
[
"HSD_DL",
"HSD_LL",
"HSD_WL",
"HSD_SL"
];
# ----------------------------------------
code_block_11 = CodeBlock { "\\.dynTemp\\"; }
folderPath = Python(IN[0]=code_block_11)  # CPython3
# ---------- folderPath.python (35 lines) ----------
# Load the Python Standard and DesignScript Libraries
import sys
import clr
clr.AddReference('ProtoGeometry')
from Autodesk.DesignScript.Geometry import *
import time
import subprocess
import os

clr.AddReference('RevitNodes')
import Revit
clr.ImportExtensions(Revit.Elements)
from Revit import Elements
# The inputs to this node will be stored as a list in the IN variables.
dataEnteringNode = IN
subPath = IN[0]
# Place your code below this line
def find_cwd():
    doc = Revit.Application.Document.Current
    filePath_string = doc.FilePath
    folderPath = filePath_string.split('\\')
    folderPath.pop(-1)
    folderPath_str = '\\'.join(folderPath)
    return folderPath_str

#cwd = find_cwd()
#cwd = os.getenv("HomePath")
#
#folderPath = f"{cwd}\\{dynTempServerPath}"
#if not os.path.exists(folderPath):
#    os.makedirs(folderPath)

# Assign your output to the OUT variable.
#OUT = map(lambda x: find_cwd() + x, subPaths) 
OUT = find_cwd() + subPath
# ----------------------------------------
code_block_12 = CodeBlock { "\\jsons"; }
moveToTempFolder = Python(IN[0]=getDirectoryContents.files, IN[1]=code_block_10, IN[2]=folderPath, IN[3]=code_block_12, IN[4]=code_block_9)  # CPython3
# ---------- moveToTempFolder.python (138 lines) ----------
# Load the Python Standard and DesignScript Libraries
import sys
import clr
clr.AddReference('ProtoGeometry')
from Autodesk.DesignScript.Geometry import *
import re
import os
import shutil
################Module For Functional Programing#########################
from functools import reduce; from itertools import chain
from itertools import groupby; import operator
from copy import deepcopy
curry = lambda f: lambda a,*args: f(a, *args) if (len(args)) else lambda *args: f(a, *args)

filter, map, reduce = curry(filter), curry(map), curry(reduce)

go = lambda *args: reduce(lambda a,f: f(a), args) ## 함수도 축약 가능 ##

def dictUpdate(dic1,dic2):
    dic1.update(dic2)
    return dic1
    
def dictsMerge(dics):
    res = reduce(dictUpdate, dics)
    return res
    
def dictDeleteKeys(dic, keys):
    for k in keys:
        del dic[k]
    return dic

def flat(a):
    if isinstance(a, list):
        for i in a: 
            yield from flat(i)
    else: yield a

def grpBy(iter, key):
    f,keys,grps = key,[],[]
    sorted_ = sorted(iter, key=f)
    for key, grp_data in groupby(sorted_,key=f):
        keys.append(key); grps.append(list(grp_data))
    return grps,keys
#########################################################################
# The inputs to this node will be stored as a list in the IN variables.
dataEnteringNode = IN
fileNames = IN[0]
loadKinds = IN[1]
tmpPath = IN[2]
subPath = IN[3]
executionMode = IN[4]

# Place your code below this line
def find_downloadPath():
    download = os.path.join(os.path.expanduser('~'), 'downloads')
    return download
    
def find_allHSD_loads(fileNames, loadKind):
    allHSDs = go(
        fileNames,
        filter(lambda x: loadKind in x),
        list,
    )
    return allHSDs
    
def select_lastHSD(fileNames, loadKind):
    allHSDs = find_allHSD_loads(fileNames, loadKind)
    if len(allHSDs) == 1:
        res = allHSDs[0]
    elif len(allHSDs) > 2:
        res = go(
            allHSDs,
            filter(lambda x: '(' in x),
            sorted,
            lambda x: x[-1],
        )
    return res

def chk_allLastHSDs(fileNames, loadKinds):
    vals = []
    for x in loadKinds:
        try:
            vals.append(select_lastHSD(fileNames, x))
        except:
            vals.append(0)
            
    
    resDict = dict(zip(loadKinds, vals))
    
    return resDict

def read_allHSDsJson(loadDict):
    resDict = {}
    for k,v in loadDict.items():
        if v == 0:
            resDict[k] = "noData"
        else:
            with open(v, 'r', encoding='utf-8') as f:
                resDict[k] = f.read()
    return resDict
    
loadDict = chk_allLastHSDs(fileNames, loadKinds)


## copy allSrcFiles to .dynTemp

allSrcFilesFullPath = list(map(lambda x: find_allHSD_loads(fileNames, x), loadKinds))
allSrcFilesNameOnly = go(
    allSrcFilesFullPath,
    map(lambda grp: go(
        grp,
        map(lambda x: x.split('\\')),
        map(lambda x: x[-1]),
        map(lambda x: '\\'+ x),
        )
    ),
    lambda x: chain(*x),
    list,
)

def moveSrcToTemp(filename, tmpPath, subPath):
    tgtPath = tmpPath + subPath
    if not os.path.exists(subPath):
        os.makedirs(subPath)
    src = find_downloadPath()
    dir = subPath
    shutil.move(src + filename, dir + filename)
    return dir + filename

if executionMode == "하중분배모드":
    res = map(lambda x: moveSrcToTemp(x, tmpPath), allSrcFilesNameOnly)
elif executionMode == "입력모드":
    res = 0

# Assign your output to the OUT variable.
#OUT = allSrcFilesNameOnly

OUT = res
# ----------------------------------------
filter_the_last_hsd_파일 = Python(IN[0]=moveToTempFolder, IN[1]=code_block_10, IN[2]=folderPath, IN[3]=code_block_12)  # CPython3
# ---------- filter_the_last_hsd_파일.python (114 lines) ----------
# Load the Python Standard and DesignScript Libraries
import sys
import clr
clr.AddReference('ProtoGeometry')
from Autodesk.DesignScript.Geometry import *
import re
import os
import shutil
################Module For Functional Programing#########################
from functools import reduce; from itertools import chain
from itertools import groupby; import operator
from copy import deepcopy
curry = lambda f: lambda a,*args: f(a, *args) if (len(args)) else lambda *args: f(a, *args)

filter, map, reduce = curry(filter), curry(map), curry(reduce)

go = lambda *args: reduce(lambda a,f: f(a), args) ## 함수도 축약 가능 ##

def dictUpdate(dic1,dic2):
    dic1.update(dic2)
    return dic1
    
def dictsMerge(dics):
    res = reduce(dictUpdate, dics)
    return res
    
def dictDeleteKeys(dic, keys):
    for k in keys:
        del dic[k]
    return dic

def flat(a):
    if isinstance(a, list):
        for i in a: 
            yield from flat(i)
    else: yield a

def grpBy(iter, key):
    f,keys,grps = key,[],[]
    sorted_ = sorted(iter, key=f)
    for key, grp_data in groupby(sorted_,key=f):
        keys.append(key); grps.append(list(grp_data))
    return grps,keys
#########################################################################
# The inputs to this node will be stored as a list in the IN variables.
dataEnteringNode = IN
moveResult = IN[0]
loadKinds = IN[1]
tmpPath = IN[2]
subPath = IN[3]
tgtPath = tmpPath + subPath

# Place your code below this line
def find_downloadPath():
    download = os.path.join(os.path.expanduser('~'), 'downloads')
    return download

def get_allSrcFromTemp(tmpPath):
    fileNames = os.listdir(tmpPath)
    res = list(map(lambda x: tmpPath + '\\' + x, fileNames))
    return res

def find_allHSD_loads(fileNames, loadKind):
    allHSDs = go(
        fileNames,
        filter(lambda x: loadKind in x),
        list,
    )
    return allHSDs
    
def select_lastHSD(fileNames, loadKind):
    allHSDs = find_allHSD_loads(fileNames, loadKind)
    allCreatedTimes = list(map(lambda x: os.path.getctime(x), fileNames))
    if len(allHSDs) == 1:
        res = allHSDs[0]
    elif len(allHSDs) > 1:
        res = go(
            zip(allHSDs,allCreatedTimes),list,
            lambda x: sorted(x, key=lambda x: x[1]),
            lambda x: x[-1][0],
        )
    return res

def chk_allLastHSDs(fileNames, loadKinds):
    vals = []
    for x in loadKinds:
        try:
            vals.append(select_lastHSD(fileNames, x))
        except:
            vals.append(0)
            
    
    resDict = dict(zip(loadKinds, vals))
    
    return resDict

def read_allHSDsJson(loadDict):
    resDict = {}
    for k,v in loadDict.items():
        if v == 0:
            resDict[k] = "noData"
        else:
            with open(v, 'r', encoding='utf-8') as f:
                resDict[k] = f.read()
    return resDict
fileNames = get_allSrcFromTemp(tgtPath)

loadDict = chk_allLastHSDs(fileNames, loadKinds)


## delete all in downloads

# Assign your output to the OUT variable.
OUT = read_allHSDsJson(loadDict), loadDict
# ----------------------------------------

latest_hsd = CodeBlock(i=filter_the_last_hsd_파일) { i[0]; }
값_있는_항목만_필터링 = Python(IN[0]=latest_hsd)  # CPython3
# ---------- 값_있는_항목만_필터링.python (58 lines) ----------
# Load the Python Standard and DesignScript Libraries
import sys
import clr
clr.AddReference('ProtoGeometry')
from Autodesk.DesignScript.Geometry import *
import json
import os
################Module For Functional Programing#########################
from functools import reduce; from itertools import chain
from itertools import groupby; import operator
from copy import deepcopy
curry = lambda f: lambda a,*args: f(a, *args) if (len(args)) else lambda *args: f(a, *args)

filter, map, reduce = curry(filter), curry(map), curry(reduce)

go = lambda *args: reduce(lambda a,f: f(a), args) ## 함수도 축약 가능 ##

def dictUpdate(dic1,dic2):
    dic1.update(dic2)
    return dic1
    
def dictsMerge(dics):
    res = reduce(dictUpdate, dics)
    return res
    
def dictDeleteKeys(dic, keys):
    for k in keys:
        del dic[k]
    return dic

def flat(a):
    if isinstance(a, list):
        for i in a: 
            yield from flat(i)
    else: yield a

def grpBy(iter, key):
    f,keys,grps = key,[],[]
    sorted_ = sorted(iter, key=f)
    for key, grp_data in groupby(sorted_,key=f):
        keys.append(key); grps.append(list(grp_data))
    return grps,keys
#########################################################################
# The inputs to this node will be stored as a list in the IN variables.
dataEnteringNode = IN
loadDict = IN[0]
# Place your code below this line
    
def del_noDataKey_inDict(loadDict):
    resDict = {}
    for k,v in loadDict.items():
        if v == "noData":
            pass
        else:
            resDict[k] = json.loads(v)
    return resDict
# Assign your output to the OUT variable.
OUT = del_noDataKey_inDict(loadDict)
# ----------------------------------------
code_block_13 = CodeBlock(i=값_있는_항목만_필터링) { i["HSD_DL"]["value"]; }
toNumber = String.ToNumber(string=code_block_13)
dl_층별_정보_kn_m² = CodeBlock(i=toNumber) { i; }
하중_값_계산 = Python(IN[0]=element_별_하중srf_할당_frame, IN[1]=allCols, IN[2]=dl_층별_정보_kn_m²)  # CPython3
# ---------- 하중_값_계산.python (81 lines) ----------
# Load the Python Standard and DesignScript Libraries
import sys
import clr
clr.AddReference('ProtoGeometry')
from Autodesk.DesignScript.Geometry import *

################Module For Functional Programing#########################
from functools import reduce; from itertools import chain
from itertools import groupby; import operator
from copy import deepcopy
curry = lambda f: lambda a,*args: f(a, *args) if (len(args)) else lambda *args: f(a, *args)

filter, map, reduce = curry(filter), curry(map), curry(reduce)

go = lambda *args: reduce(lambda a,f: f(a), args) ## 함수도 축약 가능 ##

def dictUpdate(dic1,dic2):
    dic1.update(dic2)
    return dic1
    
def dictsMerge(dics):
    res = reduce(dictUpdate, dics)
    return res
    
def dictDeleteKeys(dic, keys):
    for k in keys:
        del dic[k]
    return dic

def flat(a):
    if isinstance(a, list):
        for i in a: 
            yield from flat(i)
    else: yield a

def grpBy(iter, key):
    f,keys,grps = key,[],[]
    sorted_ = sorted(iter, key=f)
    for key, grp_data in groupby(sorted_,key=f):
        keys.append(key); grps.append(list(grp_data))
    return grps,keys
#########################################################################

# The inputs to this node will be stored as a list in the IN variables.
dataEnteringNode = IN
frameDict_forAllLv = IN[0]
allCols = IN[1]
DL_forAllLv = IN[2]
# Place your code below this line
allLvsDict_DL = go(
    frameDict_forAllLv,
    map(lambda DictsPerLv: 
        set(map(lambda d: d["lvBelong"], DictsPerLv))
    ), list,
    lambda x: chain(*x), list,sorted,
    lambda x: dict(zip(x, DL_forAllLv)),
)

def calcLoad(elemDict, loadKind, loadType, allLvsLoadDict):
    elemLv = elemDict["lvBelong"]
    asgned_area = elemDict["asgned_area"]
    DL_unitValueforElem = allLvsLoadDict[elemLv]
    calcRes = DL_unitValueforElem * asgned_area / (1000) 
    resDict = {
        "load_type": loadType,
        "wx": 0,
        "wy": -calcRes,
    }
    
    elemDict[loadKind] = resDict
    
    return elemDict

def calcLoadPerLv(elemDictsPerLv, loadKind, loadType, allLvsLoadDict):
    return list(map(lambda x: calcLoad(x, loadKind, loadType, allLvsLoadDict), elemDictsPerLv))

def calcLoad_forAllLv(elemDicts_forAllLv, loadKind, loadType, allLvsLoadDict):
    return list(map(lambda x: calcLoadPerLv(x, loadKind, loadType, allLvsLoadDict), elemDicts_forAllLv))

# Assign your output to the OUT variable.
OUT = calcLoad_forAllLv(frameDict_forAllLv, "DL", "uniform", allLvsDict_DL)
# ----------------------------------------
code_block_14 = CodeBlock(i=하중_값_계산) { i[0][5]["asgned_srfs"]; }
count = List.Count(list=code_block_13)
거더_필터링_기둥과_교차_여부 = Python(IN[0]=all_elements_of_category, IN[1]=all_elements_of_category_3, IN[2]=count)  # CPython3
# ---------- 거더_필터링_기둥과_교차_여부.python (110 lines) ----------
# Load the Python Standard and DesignScript Libraries
import sys
import clr
clr.AddReference('ProtoGeometry')
from Autodesk.DesignScript.Geometry import *

################Module For Functional Programing#########################
from functools import reduce; from itertools import chain
from itertools import groupby; import operator
from copy import deepcopy
curry = lambda f: lambda a,*args: f(a, *args) if (len(args)) else lambda *args: f(a, *args)

filter, map, reduce = curry(filter), curry(map), curry(reduce)

go = lambda *args: reduce(lambda a,f: f(a), args) ## 함수도 축약 가능 ##

def dictUpdate(dic1,dic2):
    dic1.update(dic2)
    return dic1
    
def dictsMerge(dics):
    res = reduce(dictUpdate, dics)
    return res
    
def dictDeleteKeys(dic, keys):
    for k in keys:
        del dic[k]
    return dic

def flat(a):
    if isinstance(a, list):
        for i in a: 
            yield from flat(i)
    else: yield a

def grpBy(iter, key):
    f,keys,grps = key,[],[]
    sorted_ = sorted(iter, key=f)
    for key, grp_data in groupby(sorted_,key=f):
        keys.append(key); grps.append(list(grp_data))
    return grps,keys
#########################################################################

# The inputs to this node will be stored as a list in the IN variables.
dataEnteringNode = IN
allFrames = IN[0]
allCols = IN[1]
userinputStory = IN[2]
# Place your code below this line

def chck_intsctWithCols(frame, allColsGeo):
    frameLocation = frame\
                    .GetLocation()\
                    .ExtendStart(500)\
                    .ExtendEnd(500)
    res = frameLocation.DoesIntersect(allColsGeo)
    
    return res

def filter_allGirders(allFrames, allCols):
    allColsGeo = go(
        allCols,
        map(lambda x: x.Geometry()[0]),list,
        Solid.ByUnion,
    )
    res = go(
        allFrames,
        filter(lambda x: chck_intsctWithCols(x, allColsGeo)),
        list,
    )
    return res

allGirders = filter_allGirders(allFrames, allCols)

def find_allLinePts(allGirders, allCols):
    # 거더는 StartPoint 혹은 레퍼런스 레벨별로 그루핑해서
    # Z 값은 레벨에서의 StartPoint 만 가져와서 구배는 반영안하도록
    girdersPerRefLvGrp = grpBy(allGirders, lambda x: x.GetParameterValueByName("Reference Level Elevation") )
    
    girdersLines = list(map(lambda x: x.GetLocation(), allGirders))
    girdersPts = [x.StartPoint for x in girdersLines] + \
                 [x.EndPoint for x in girdersLines]
    colsLines = go(
        allCols,
        map(lambda x: x.GetLocation()),
        list,
    )
    colsPts = [x.StartPoint for x in colsLines] + \
              [x.EndPoint for x in colsLines]
    allPts = girdersPts + colsPts
    allX = go(
        allPts,
        map(lambda x: x.X), set,
        sorted,
    )
    allY = go(
        allPts,
        map(lambda x: x.Y), set,
        sorted,
    )
    allZ = go(
        allPts,
        map(lambda x: x.Z), set,
        sorted,
    )
    
    return girdersPerRefLvGrp, allZ

# Assign your output to the OUT variable.
OUT = allGirders, find_allLinePts(allGirders, allCols)
# ----------------------------------------
code_block_15 = CodeBlock(i=거더_필터링_기둥과_교차_여부) { i[0]; }
parameters_2 = Element.Parameters(element=code_block_15)
전입면_경간_면_생성_col = Python(IN[0]=concave_hull, IN[1]=allCols)  # CPython3; frozen
# ---------- 전입면_경간_면_생성_col.python (146 lines) ----------
# Load the Python Standard and DesignScript Libraries
import sys
import clr
clr.AddReference('ProtoGeometry')
from Autodesk.DesignScript.Geometry import *
from Autodesk.DesignScript.Geometry import Line

from math import sqrt, hypot
from itertools import combinations
################Module For Functional Programing#########################
from functools import reduce; from itertools import chain
from itertools import groupby; import operator
from copy import deepcopy
curry = lambda f: lambda a,*args: f(a, *args) if (len(args)) else lambda *args: f(a, *args)

filter, map, reduce = curry(filter), curry(map), curry(reduce)

go = lambda *args: reduce(lambda a,f: f(a), args) ## 함수도 축약 가능 ##

def dictUpdate(dic1,dic2):
    dic1.update(dic2)
    return dic1
    
def dictsMerge(dics):
    res = reduce(dictUpdate, dics)
    return res
    
def dictDeleteKeys(dic, keys):
    for k in keys:
        del dic[k]
    return dic

def flat(a):
    if isinstance(a, list):
        for i in a: 
            yield from flat(i)
    else: yield a

def grpBy(iter, key):
    f,keys,grps = key,[],[]
    sorted_ = sorted(iter, key=f)
    for key, grp_data in groupby(sorted_,key=f):
        keys.append(key); grps.append(list(grp_data))
    return grps,keys
#########################################################################
    
# The inputs to this node will be stored as a list in the IN variables.
dataEnteringNode = IN
concave_hull = IN[0]
#loadPerLevel = IN[1]
elems_forAllLv = IN[1]
#gridsX, gridsY = grids

# Place your code below this line


def grp_XYbeamsLinesPerLv(elemsPerLv):
    allLines = go(
        elemsPerLv,
        map(lambda x: x.GetLocation()),
        list,
    )
    directionsPerLevel = go(
        allLines,
        map(lambda x: x.Direction),
        map(lambda x: x.Normalized()),
        list,
    )
    
    isParallel = lambda e: go(
        e,
        lambda x: x.Direction,
        lambda x: x.Normalized(),
        lambda x: not x.IsParallel(directionsPerLevel[0]),
    )
    
    
    return grpBy(allLines, isParallel)[0]

def make_pairFrames(xGrps, yGrps):
    pairX = go(
        xGrps,
        lambda x: sorted(x, key=lambda e: e.StartPoint.X),
        lambda x: grpBy(x, key=lambda e: e.StartPoint.X)[0],
        map(lambda x: sorted(x, key=lambda e: e.StartPoint.Y)),
        #2개씩 1간격으로 서브리스트 생성
        map(lambda x: list(map(lambda n: x[n:n+1+1], range(len(x))[:-1]))),
        lambda x: list(chain(*x)),
    )
    pairY = go(
        yGrps,
        lambda x: sorted(x, key=lambda e: e.StartPoint.X),
        lambda x: grpBy(x, key=lambda e: e.StartPoint.X)[0],
        map(lambda x: sorted(x, key=lambda e: e.StartPoint.Y)),list,
        #2개씩 1간격으로 서브리스트 생성
        lambda x: list(map(lambda n: x[n:n+1+1], range(len(x))[:-1])),
        # 서브리스트 구조 Transpose
        map(lambda x: list(zip(*chain(x)))),
        lambda x: list(chain(*x)),
    )
    return pairX, pairY

def get_IntersectInGrp(xGrp, yGrp):
    res = []
    for x in xGrp:
        for y in yGrp:
            res.append(x.Intersect(y))
    return list(chain(*res))

def GetBoundingSrfs(intscts):
    res = []
    try:
        crvSet = concave_hull(intscts, 100000)
        polyCrv = PolyCurve.ByJoinedCurves(crvSet)
        srf = Surface.ByPatch(polyCrv)
        srfThick = srf.Thicken(10,False)
#        bdCube = BoundingBox.ByGeometry(srfThick).ToCuboid()
#        bdCubeSrfs = bdCube.Explode()
#        bdBelowSrf = go(
#            bdCube.Explode(),
#            #bdCubeSrfs,
#            filter(lambda x: x.NormalAtParameter(0.5,0.5).Z != 0),
#            list,
#        )[0]
        return srf
    except: pass

def makeSrf_btwnFrame(xGrps, yGrps):
    res = []
    for xGrp in xGrps:
        for yGrp in yGrps:
            intscts = get_IntersectInGrp(xGrp, yGrp)
            if GetBoundingSrfs(intscts):
                res.append(GetBoundingSrfs(intscts))

    return res


# Assign your output to the OUT variable.
XY_elems_forAllLv = list(map(grp_XYbeamsLinesPerLv, elems_forAllLv))
pairFrames_forAllLv = list(map(lambda x: list(make_pairFrames(*x)), XY_elems_forAllLv))
srfs_forAllLv = list(map(lambda x: list(makeSrf_btwnFrame(*x)), pairFrames_forAllLv))

srfs_forAllSide

OUT = srfs_forAllLv
# ----------------------------------------
전층_경간면_내부_등분선_찾기_col = Python(IN[0]=concave_hull, IN[1]=전입면_경간_면_생성_col)  # CPython3; same code as 전층_경간면_내부_등분선_찾기
code_block_16 = CodeBlock(frames=code_block_15) { frames; }
code_block_17 = CodeBlock { "Reference Level Elevation"; }
getParameterValueByName_2 = Element.GetParameterValueByName(element=code_block_16, parameterName=code_block_17)
groupByKey = List.GroupByKey(list=code_block_16, keys=getParameterValueByName_2)
code_block_18 = CodeBlock(elems_forAllLv=groupByKey.groups) { elems_forAllLv; }
element_별_하중srf_할당_col = Python(IN[1]=전층_경간면_내부_등분선_찾기_col, IN[2]=code_block_18)  # CPython3; unwired: IN[0]
# ---------- element_별_하중srf_할당_col.python (123 lines) ----------
# Load the Python Standard and DesignScript Libraries
import sys
import clr
clr.AddReference('ProtoGeometry')
from Autodesk.DesignScript.Geometry import *

################Module For Functional Programing#########################
from functools import reduce; from itertools import chain
from itertools import groupby; import operator
from copy import deepcopy
curry = lambda f: lambda a,*args: f(a, *args) if (len(args)) else lambda *args: f(a, *args)

filter, map, reduce = curry(filter), curry(map), curry(reduce)

go = lambda *args: reduce(lambda a,f: f(a), args) ## 함수도 축약 가능 ##

def dictUpdate(dic1,dic2):
    dic1.update(dic2)
    return dic1
    
def dictsMerge(dics):
    res = reduce(dictUpdate, dics)
    return res
    
def dictDeleteKeys(dic, keys):
    for k in keys:
        del dic[k]
    return dic

def flat(a):
    if isinstance(a, list):
        for i in a: 
            yield from flat(i)
    else: yield a

def grpBy(iter, key):
    f,keys,grps = key,[],[]
    sorted_ = sorted(iter, key=f)
    for key, grp_data in groupby(sorted_,key=f):
        keys.append(key); grps.append(list(grp_data))
    return grps,keys
#########################################################################

# The inputs to this node will be stored as a list in the IN variables.
dataEnteringNode = IN
srfs_forAllLv = IN[1]
elems_forAllLv = IN[2]
# Place your code below this line
def grp_XYbeamsPerLv(elemsPerLv):
#    allLines = go(
#        elemsPerLv,
#        map(lambda x: x.GetLocation()),
#        list,
#    )
    directionsPerLevel = go(
        elemsPerLv,
        map(lambda x: x.GetLocation()),
        map(lambda x: x.Direction),
        map(lambda x: x.Normalized()),
        list,
    )
    
    isParallel = lambda e: go(
        e,
        lambda x: x.GetLocation(),
        lambda x: x.Direction,
        lambda x: x.Normalized(),
        lambda x: not x.IsParallel(directionsPerLevel[0]),
    )
    
    
    return grpBy(elemsPerLv, isParallel)[0]

elemsX_forAllLv = go(
    elems_forAllLv,
    map(grp_XYbeamsPerLv),
    list,
    map(lambda x: x[1]),
    list,
)

elemsY_forAllLv = go(
    elems_forAllLv,
    map(grp_XYbeamsPerLv),
    list,
    map(lambda x: x[0]),
    list,
)

def find_intsctSrfs(elem, srfs_perLv):
    #elemGeo = elem.Geometry()
    elemLineforChck = elem\
                        .GetLocation()\
                        .ExtendStart(-100)\
                        .ExtendEnd(-100)
    assignedSrfs = go(
        srfs_perLv,
        filter(lambda x: x["load_path"]=="1way"),
        filter(lambda x: elemLineforChck.DoesIntersect(x["srf"])),
        list,
    )
    
    res = {
        "elem": elem,
        "location_line": elem.GetLocation(),
        "length": elem.GetLocation().Length,
        "asgned_Srfs": list(map(lambda x: x["srf"], assignedSrfs)),
        "asgned_area": round(sum(list(map(lambda x: x["srf"].Area/1000000, assignedSrfs))),2)
    }
    
    return res

def find_intsctSrfsPerLv(elemsPerLv, srfs_perLv):
    return list(map(lambda x: find_intsctSrfs(x, srfs_perLv), elemsPerLv))

res = go(
    elemsX_forAllLv,
    lambda x: list(zip(x, srfs_forAllLv)),
    map(lambda x: find_intsctSrfsPerLv(*x)),
)

# Assign your output to the OUT variable.
OUT = res
# ----------------------------------------
콘크리트_강도_선택 = IntegerSlider(1, range=0..40 step 1)
code_block_19 = CodeBlock(i=toDict_allBeams) { i["lvBelong"]; }
uniqueItems = List.UniqueItems(list=code_block_19)
code_block_20 = CodeBlock(i=하중_값_계산) { i["startNode"]["name"]; }
uniqueItems_2 = List.UniqueItems(list=code_block_20@L2)
file_path = Filename("..\..\etc\_팀교육\StrToolkit\frame_json_sample_0613.txt")
flatten_2 = List.Flatten(list=하중_값_계산)
toDict_allCols = Python(IN[0]=allCols, IN[1]=getLevelsDict, IN[2]=longAxis, IN[3]=shortAxis, IN[4]=탄성계수)  # CPython3
# ---------- toDict_allCols.python (183 lines) ----------
# Load the Python Standard and DesignScript Libraries
import sys
import clr
clr.AddReference('ProtoGeometry')
from Autodesk.DesignScript.Geometry import *

################Module For Functional Programing#########################
from functools import reduce; from itertools import chain
from itertools import groupby; import operator
from copy import deepcopy
curry = lambda f: lambda a,*args: f(a, *args) if (len(args)) else lambda *args: f(a, *args)

filter, map, reduce = curry(filter), curry(map), curry(reduce)

go = lambda *args: reduce(lambda a,f: f(a), args) ## 함수도 축약 가능 ##

def dictUpdate(dic1,dic2):
    dic1.update(dic2)
    return dic1
    
def dictsMerge(dics):
    res = reduce(dictUpdate, dics)
    return res
    
def dictDeleteKeys(dic, keys):
    for k in keys:
        del dic[k]
    return dic

def flat(a):
    if isinstance(a, list):
        for i in a: 
            yield from flat(i)
    else: yield a

def grpBy(iter, key):
    f,keys,grps = key,[],[]
    sorted_ = sorted(iter, key=f)
    for key, grp_data in groupby(sorted_,key=f):
        keys.append(key); grps.append(list(grp_data))
    return grps,keys
#########################################################################
# The inputs to this node will be stored as a list in the IN variables.
dataEnteringNode = IN
allLvsDict = IN[1]
allCols = IN[0]
frameNoDict = IN[2]
shortAxisNoDict = IN[3]
input_E = IN[4]
# Place your code below this line
def get_BuilingBdBox(allCols):
    allCols_loc = list(map(lambda x: x.GetLocation(),allCols))
    bdBox = BoundingBox.ByGeometry(allCols_loc).ToCuboid()
    return bdBox

def getSideDict(allCols):
    allCols_loc = list(map(lambda x: x.GetLocation(),allCols))
    bdBoxFaces = get_BuilingBdBox(allCols).Explode()
    sideFaces = go(
        bdBoxFaces,
        filter(lambda x: x.NormalAtParameter(0.5,0.5).Z == 0),
        list,
    )
    resDict = go(
        ["south","west","north","east"],
        lambda x: zip(x, sideFaces),
        dict,
    )
    
    return resDict

def toDict_allCols(allCols, frameNoDict, allLvsDict):

    def find_Ix(elem):
        _tw = elem.GetParameterValueByName("Family and Type")\
            .GetParameterValueByName("Web Thickness") * 10
        _tf = elem.GetParameterValueByName("Family and Type")\
            .GetParameterValueByName("Flange Thickness") * 10
        _h = elem.GetParameterValueByName("Family and Type")\
            .GetParameterValueByName("Height") * 10
        _bf = elem.GetParameterValueByName("Family and Type")\
            .GetParameterValueByName("Width") * 10
        
        Ix = (2*(_bf*_tf**3/12+_bf*_tf*((_h-2*_tf)/2+_tf/2)**2)+_tw*(_h-2*_tf)**3/12)
        Ix_revit = elem.GetParameterValueByName("Family and Type")\
            .GetParameterValueByName("Moment of Inertia strong axis") * 10**4
        return Ix_revit

    def find_numberNameByElem(elem, nameDict, axis):
        tgtDict = {
            "X": elem.GetLocation().StartPoint.X,
            "Y": elem.GetLocation().StartPoint.Y,
            "Z": elem.GetLocation().StartPoint.Z,
        }
        res = []
        tgt = tgtDict[axis]
        for k,v in list(nameDict.items()):
            if v == tgt:
                res.append(k)
        return res

    def find_numberNameByPt(pt, nameDict, axis):
        tgtDict = {
            "X": pt.X,
            "Y": pt.Y,
            "Z": pt.Z,
        }
        res = []
        tgt = tgtDict[axis]
        for k,v in list(nameDict.items()):
            if v == tgt:
                res.append(k)
        return res

    def find_nodeName(elem, frameNoDict, shortAxisNoDict, allLvsDict):
        sttPt = elem.GetLocation().StartPoint
        
        endPt = elem.GetLocation().EndPoint
        
        name_stt_X = find_numberNameByPt(sttPt, frameNoDict, "X")[0]
        name_stt_Y = find_numberNameByPt(sttPt, shortAxisNoDict, "Y")[0]
        name_stt_Z = find_numberNameByPt(sttPt, allLvsDict, "Z")[0]
        name_stt = "1" + name_stt_X + name_stt_Y + name_stt_Z
        
        sttNodeDict = dict([("name",name_stt), ("Y",sttPt.Y), ("Z",sttPt.Z)])
        
        name_end_X = find_numberNameByPt(endPt, frameNoDict, "X")[0]
        name_end_Y = find_numberNameByPt(endPt, shortAxisNoDict, "Y")[0]
        name_end_Z = find_numberNameByPt(endPt, allLvsDict, "Z")[0]
        name_end = "1" + name_end_X + name_end_Y + name_end_Z
        
        endNodeDict = dict([("name",name_end), ("Y",endPt.Y), ("Z",endPt.Z)])
        
        return sttNodeDict, endNodeDict

    sideDict = getSideDict(allCols)    
        
    def findSide(col, sideDict):
        res = []
        for k,v in list(sideDict.items()):
            if col.Geometry()[0].DoesIntersect(v):
                res.append(k)
        return res
    
    def convertElementName(elem, replaceIDX, replaceChar):
        element_name = list(find_nodeName(elem, frameNoDict, shortAxisNoDict, allLvsDict)[0]["name"])
        element_name[replaceIDX] = replaceChar
        element_name_modified = "".join(element_name)
        return element_name_modified
    
    resDict = go(
        allCols,
        map( lambda x: {
            "elem": x,
            "element_name": convertElementName(x, 0, "2"),
            "sectionProp":{
                "name": x.GetParameterValueByName("Type").GetParameterValueByName("Type Name"),
                "sectionRotating": x.GetParameterValueByName("Cross-Section Rotation"),
                "A": x.GetParameterValueByName("Family and Type")\
                .GetParameterValueByName("Section Area") * 10**2,
                "I": find_Ix(x),
                "E": input_E,
            },
            "GUID": x.GetParameterValueByName("IfcGUID"),
            "role": "Column",
            "location_line": x.GetLocation(),
            "startNode": find_nodeName(x, frameNoDict, shortAxisNoDict, allLvsDict)[0],
            "endNode": find_nodeName(x, frameNoDict, shortAxisNoDict, allLvsDict)[1],
            "planeDirection": "n/a",
            "length": x.GetLocation().Length,
            "asgned_srfs": [],
            "asgned_area": 0,
            "frameNo": find_numberNameByElem(x, frameNoDict, "X")[0],
            "lvBelong": find_numberNameByElem(x, allLvsDict, "Z")[0],
            "sideBelong": findSide(x, sideDict),
        } )
    )
    
    return resDict

res = toDict_allCols(allCols, frameNoDict, allLvsDict)
# Assign your output to the OUT variable.
OUT = res
# ----------------------------------------
최하단_기둥_지점조건_부여 = Python(IN[0]=toDict_allCols)  # CPython3
# ---------- 최하단_기둥_지점조건_부여.python (84 lines) ----------
# Load the Python Standard and DesignScript Libraries
import sys
import clr
clr.AddReference('ProtoGeometry')
from Autodesk.DesignScript.Geometry import *

################Module For Functional Programing#########################
from functools import reduce; from itertools import chain
from itertools import groupby; import operator
from copy import deepcopy
curry = lambda f: lambda a,*args: f(a, *args) if (len(args)) else lambda *args: f(a, *args)

filter, map, reduce = curry(filter), curry(map), curry(reduce)

go = lambda *args: reduce(lambda a,f: f(a), args) ## 함수도 축약 가능 ##

def dictUpdate(dic1,dic2):
    dic1.update(dic2)
    return dic1
    
def dictsMerge(dics):
    res = reduce(dictUpdate, dics)
    return res
    
def dictDeleteKeys(dic, keys):
    for k in keys:
        del dic[k]
    return dic

def flat(a):
    if isinstance(a, list):
        for i in a: 
            yield from flat(i)
    else: yield a

def grpBy(iter, key):
    f,keys,grps = key,[],[]
    sorted_ = sorted(iter, key=f)
    for key, grp_data in groupby(sorted_,key=f):
        keys.append(key); grps.append(list(grp_data))
    return grps,keys
#########################################################################
# The inputs to this node will be stored as a list in the IN variables.
dataEnteringNode = IN
allColDicts = IN[0]

# Place your code below this line
def find_btmCols(allColDicts):
    t = go(
        allColDicts,
        filter(lambda x: min([x["startNode"]["Z"],x["endNode"]["Z"]]) == 0),
        list,
    )
    f = go(
        allColDicts,
        filter(lambda x: min([x["startNode"]["Z"],x["endNode"]["Z"]]) != 0),
        list,
    )
    return t,f

def add_bndryToColDict(elemDict, condition):
    elemDict["boundary"] = {
        "node_name": elemDict["startNode"]["name"],
        "condition": condition
    }
    return elemDict

def add_bndryToAllColDict(elemDicts, conditions):
    if isinstance(conditions[0],list):
        inputPairs = zip(elemDicts, conditions)
        res = list(map(lambda x: add_bndryToColDict(*x), elemDicts))
    elif not isinstance(conditions[0],list):
        res = list(map(lambda x: add_bndryToColDict(x, conditions), elemDicts))
    
    return res

btmCols, otherCols = find_btmCols(allColDicts)

new_btmCols = add_bndryToAllColDict(btmCols, [1,1,1])


res = new_btmCols + otherCols
# Assign your output to the OUT variable.
OUT = res
# ----------------------------------------
code_block_21 = CodeBlock(allColDicts=최하단_기둥_지점조건_부여) { allColDicts; }
join = List.Join(list0=flatten_2, list1=code_block_21)
code_block_22 = CodeBlock { "elem"; "location_line"; "asgned_srfs"; }
removeKeys = DesignScript.Builtin.Dictionary.RemoveKeys(dictionary=join, keys=code_block_22.out0)
removeKeys_2 = DesignScript.Builtin.Dictionary.RemoveKeys(dictionary=removeKeys, keys=code_block_22.out1)
removeKeys_3 = DesignScript.Builtin.Dictionary.RemoveKeys(dictionary=removeKeys_2, keys=code_block_22.out2)
code_block_23 = CodeBlock(i=removeKeys_3) { i; }
code_block_24 = CodeBlock(i=code_block_23) { i["frameNo"]; }
groupByKey_2 = List.GroupByKey(list=code_block_23, keys=code_block_24)
stringifyJSON = Data.StringifyJSON(values=groupByKey_2.groups)
writeText = FileSystem.WriteText(filePath=file_path, text=stringifyJSON)  # frozen
code_block_25 = CodeBlock(i=groupByKey_2.groups) { i["element_name"]; }
code_block_26 = CodeBlock(i=toDict_allBeams) { i; }
code_block_27 = CodeBlock(i=code_block_26) { i["frameNo"]; }
groupByKey_3 = List.GroupByKey(list=code_block_26, keys=code_block_27)
code_block_28 = CodeBlock(i=groupByKey_3.groups) { i["elem"].Geometry(); }
count_2 = List.Count(list=code_block_28@L3)
code_block_29 = CodeBlock(i=code_block_28) { i[2]; }
code_block_30 = CodeBlock(i=하중_값_계산) { i[2][5]["elem"].Geometry(); }
count_3 = List.Count(list=groupByKey_2.groups@L2)
code_block_31 = CodeBlock { ":"; " "; "\n"; }
split_4 = String.Split(string=n3_b_wind_information_입력_대괄호_항목, separator0=code_block_31.out2)
code_block_32 = CodeBlock(i=toDict_allBeams) { i["location_line"]; }
code_block_33 = CodeBlock(i=toDict_allCols) { i["location_line"]; }
code_block_34 = CodeBlock(i=all_elements_of_category_3) { i.GetLocation(); }
byGeometry = BoundingBox.ByGeometry(geom=code_block_34)
toCuboid = BoundingBox.ToCuboid(boundingBox=byGeometry)
join_2 = List.Join(list0=all_elements_of_category, list1=all_elements_of_category_3)
code_block_35 = CodeBlock(i=join_2) { i.Geometry(); }
code_block_36 = CodeBlock(i=전층_경간면_내부_등분선_찾기) { i["srf"]; }
code_block_37 = CodeBlock(i=code_block_36)
# ---------- code_block_37.designscript (4 lines) ----------
[
i[2][5],
i[2][8]
];
# ----------------------------------------
code_block_38 = CodeBlock(i=toDict_allBeams)
# ---------- code_block_38.designscript (4 lines) ----------
[
i["startNode"],
i["endNode"]
];
# ----------------------------------------
transpose = List.Transpose(lists=code_block_38)
code_block_39 = CodeBlock(i=groupByKey_2.groups) { i[0]; }
code_block_40 = CodeBlock(i=code_block_39)  # same code as code_block_38
transpose_2 = List.Transpose(lists=code_block_40)
count_4 = List.Count(list=최하단_기둥_지점조건_부여@L2)
count_5 = List.Count(list=toDict_allCols)
code_block_41 = CodeBlock(i=최하단_기둥_지점조건_부여) { i["boundary"]; }  # frozen
code_block_42 = CodeBlock(mode=n0_실행모드) { mode; }

# group: HTML Export
javascriptPart = Python()  # CPython3; unwired: IN[0], IN[1], IN[2]
# ---------- javascriptPart.python (156 lines) ----------
# Load the Python Standard and DesignScript Libraries
import sys
import clr
clr.AddReference('ProtoGeometry')
from Autodesk.DesignScript.Geometry import *

# The inputs to this node will be stored as a list in the IN variables.
dataEnteringNode = IN


# Place your code below this line
jsPart = '''
function setEventListener(target) {
    document.addEventListener('DOMContentLoaded', () => {
        const increaseButton = document.getElementById('increaseButton');
        const decreaseButton = document.getElementById('decreaseButton');
        const inputContainer = document.getElementById(target + 'inputContainer');
        let inputCount = 0;

        increaseButton.addEventListener('click', () => {
            inputCount++;
            const inputGroup = document.createElement('div');
            inputGroup.className = target + 'inputGroup';

            const label = document.createElement('label');
            label.textContent = inputCount + '.';

            const newInput = document.createElement('input');
            newInput.type = 'number';
            newInput.placeholder = 'Enter load in kN/m²';

            inputGroup.appendChild(label);
            inputGroup.appendChild(newInput);
            inputContainer.appendChild(inputGroup);
        });

        decreaseButton.addEventListener('click', () => {
            if (inputContainer.lastChild) {
                inputContainer.removeChild(inputContainer.lastChild);
                inputCount--;
            }
        });
    });
}


function download(filename, text) {
    var element = document.createElement('a');
    element.setAttribute('href', 'data:text/plain;charset=utf-8,' + encodeURIComponent(text));
    const timeFilename = filename + Date.now().toString()
    element.setAttribute('download', timeFilename);
  
    element.style.display = 'none';
    document.body.appendChild(element);
  
    element.click();
  
    document.body.removeChild(element);
}

// download('test.txt', 'Hello world!');

function get_DL_json() {
    const inputs = document.querySelectorAll('.DLinputGroup input');
    const res = inputs.values()
    const values = [];
    inputs.forEach((input, index) => {
        values.push({ id: index + 1, value: input.value });
    });
    console.log(values);
    const jsonStr = JSON.stringify(values);
    return jsonStr;
}

function get_LL_json() {
    const inputs = document.querySelectorAll('.LLinputGroup input');
    const res = inputs.values()
    const values = [];
    inputs.forEach((input, index) => {
        values.push({ id: index + 1, value: input.value });
    });
    console.log(values);
    const jsonStr = JSON.stringify(values);
    return jsonStr;
}

function get_WindInfo_json() {
    const labels_ = document.querySelectorAll('.form-group-wind label');
    
    const labels = [];
    labels_.forEach((e) => {
        labels.push(e.innerHTML)
    });

    var vals_ = document.querySelectorAll('.wind_vals');
    const vals = [];
    vals_.forEach((e) => {
        vals.push(e.value)
    });

    const kvPairDict = {};
    for (let i = 0; i < labels.length; i++) {
        kvPairDict[labels[i]] = vals[i];
      };
    
    const resDict = {
        "wind_info": kvPairDict
    };
    const jsonStr = JSON.stringify(resDict);
    console.log(jsonStr);
    return jsonStr;
}

function get_SeismicInfo_json() {
    const labels_ = document.querySelectorAll('.form-group-seismic label');
    
    const labels = [];
    labels_.forEach((e) => {
        labels.push(e.innerHTML)
    });

    var vals_ = document.querySelectorAll('.seismic_vals');
    const vals = [];
    vals_.forEach((e) => {
        vals.push(e.value)
    });

    const kvPairDict = {};
    for (let i = 0; i < labels.length; i++) {
        kvPairDict[labels[i]] = vals[i];
      };
    
    const resDict = {
        "seismic_info": kvPairDict
    };
    const jsonStr = JSON.stringify(resDict);
    console.log(jsonStr);
    return jsonStr;
}

function saveLoadData_asJson(filename,jsonStr) {
    
    download(filename, jsonStr) 
    alert("Save Completed!")

}




setEventListener('DL');
setEventListener('LL');
	
'''
# Assign your output to the OUT variable.
OUT = jsPart
# ----------------------------------------
cssPart = Python()  # CPython3; unwired: IN[0], IN[1], IN[2]
# ---------- cssPart.python (124 lines) ----------
# Load the Python Standard and DesignScript Libraries
import sys
import clr
clr.AddReference('ProtoGeometry')
from Autodesk.DesignScript.Geometry import *

# The inputs to this node will be stored as a list in the IN variables.
dataEnteringNode = IN

# Place your code below this line
cssPart = '''
/* style.css */

body {
    font-family: Arial, sans-serif;
    /*display: flex;
    justify-content: center;
    align-items: center;*/
    height: 100vh;
    margin: 0;
    background-color: #f0f0f0;
}

.header {
    justify-content: center;
    align-items: center;
    text-align: center;
    margin: 50px 20px 100px 20px;
}

.content {
    font-family: Arial, sans-serif;
    display: flex;
    justify-content: center;
    align-items: flex-start;
    height: 100vh;
    margin: 0;
    background-color: #f0f0f0;
}
.container {
    background: #fff;
    padding: 20px;
    margin: 5px 5px 5px 5px;
    border-radius: 8px;
    box-shadow: 0 0 10px rgba(0, 0, 0, 0.1);
    width: 350px;
    text-align: center;
    align-content: stretch;
    /*align-items: flex-start;*/
}

h1 {
    margin-bottom: 20px;
}

.form-group {
    margin-bottom: 15px;
    text-align: left;
}
.form-group-wind {
    margin-bottom: 15px;
    text-align: left;
}
.form-group-seismic {
    margin-bottom: 15px;
    text-align: left;
}

label {
    display: block;
    margin-bottom: 5px;
}

input, select {
    width: 100%;
    padding: 8px;
    box-sizing: border-box;
}

button {
    padding: 10px 20px;
    background: #007bff;
    border: none;
    color: #fff;
    border-radius: 4px;
    cursor: pointer;
}

button:hover {
    background: #0056b3;
}

#result {
    margin-top: 20px;
    font-size: 18px;
    font-weight: bold;
}

#increaseButton, #decreaseButton {
    font-size: 2rem;
    padding: 5px 5px;
    margin: 5px;
}

#inputContainer {
    display: flex;
    flex-direction: column;
    align-items: center;
}

.inputGroup {
    display: flex;
    align-items: center;
    margin: 5px 0;
}

.inputGroup label {
    margin-right: 10px;
    font-size: 1rem;
}

'''
# Assign your output to the OUT variable.
OUT = cssPart
# ----------------------------------------
navHTML_Part = Python()  # CPython3; unwired: IN[0]
# ---------- navHTML_Part.python (28 lines) ----------
# Load the Python Standard and DesignScript Libraries
import sys
import clr
clr.AddReference('ProtoGeometry')
from Autodesk.DesignScript.Geometry import *

# The inputs to this node will be stored as a list in the IN variables.
dataEnteringNode = IN

# Place your code below this line
navPart = f'''

<nav class="navbar">

  <ul class="navbar__menu">
    <li id="home">Home</li>
    <li id="info">Project Information</li>
    <li id="famType">Used Family Types</li>
    <li id="roomInfo">Room Information_입력용</li>
    <li id="roomInfo_chk">Room Information_검토용</li>
  </ul>

</nav>

'''

# Assign your output to the OUT variable.
OUT = navPart
# ----------------------------------------
list_create = List.Create()  # unwired: item0, item1, item2, item3, item4
make_htmlStr = Python(IN[0]=javascriptPart, IN[1]=cssPart, IN[2]=navHTML_Part, IN[4]=list_create)  # CPython3; unwired: IN[3]
# ---------- make_htmlStr.python (173 lines) ----------
# Load the Python Standard and DesignScript Libraries
import sys
import clr
clr.AddReference('ProtoGeometry')
from Autodesk.DesignScript.Geometry import *

# The inputs to this node will be stored as a list in the IN variables.
dataEnteringNode = IN
jsPart = IN[0]
cssPart = IN[1]
navPart = IN[2]



# Place your code below this line
##folderPath_r = folderPath.replace('\\','\\\\')

htmlStr = f'''
<!DOCTYPE html>
<html lang="en">
<head>
    <meta charset="UTF-8">
    <meta name="viewport" content="width=device-width, initial-scale=1.0">
    <title>Load Information Input Window</title>
</head>
<style>
{cssPart}
</style>

<body>

<div class="header">
<h1>::: Load Information Input Center :::</h1>
</div>

<div class="content">
    <div class="container">
        <h2>Dead Load Information 입력기</h2>
        <div class="form-group">
            <label for="DLinput">층별 DL 입력 (kN/m²)</label>
                <button id="increaseButton">+</button>
                <button id="decreaseButton">-</button>
                <div id="DLinputContainer"></div>
        </div>
        <button onclick="saveLoadData_asJson('HSD_DL.json', get_DL_json())">Save Data</button>
        <div id="result"></div>
    </div>
    
    <div class="container">
        <h2>Live Load Information 입력기</h2>
        <div class="form-group">
            <label for="LLinput">층별 LL 입력 (kN/m²)</label>
                <button id="increaseButton">+</button>
                <button id="decreaseButton">-</button>
                <div id="LLinputContainer"></div>
        </div>
        <button onclick="saveLoadData_asJson('HSD_LL.json', get_LL_json())">Save Data</button>
        <div id="result"></div>
    </div>
    
    <div class="container" id="wind-Pane">
        <h2>Wind Load Info. 입력기</h2>
        <div class="form-group-wind">
            <label for="wind-codeSelect">코드선택</label>
            <select class="wind_vals" id="wind-codeSelect">
                <option value="NA">None Application</option>
                <option value="ASCE">ASCE 7-22</option>
                <option value="KDS">KDS 41 12 00</option>
                <option value="EN">EN1991-1-1-4</option>
            </select>
        </div>
        <div class="form-group-wind">
            <label for="BasicWindSpeed">Basic Wind Speed (m/s)</label>
            <input class="wind_vals" type="number" id="BasicWindSpeed" placeholder="Enter wind speed in m/s">
        </div>
        <div class="form-group-wind">
            <label for="exposureCategory">Exposure Category</label>
            <select class="wind_vals" id="exposureCategory">
                <option value="A">A</option>
                <option value="B">B</option>
                <option value="C">C</option>
                <option value="D">D</option>
            </select>
        </div>
        <div class="form-group-wind">
            <label for="TopoFactor">Topographic factor(Kzt)</label>
            <input class="wind_vals" type="number" id="TopoFactor" placeholder="Enter factor value">
        </div>
        <div class="form-group-wind">
            <label for="enclosureClass">Enclosure Classification</label>
            <select class="wind_vals" id="exposureCategory">
                <option value="A">Shelter</option>
                <option value="B">Building - Enclosed</option>
                <option value="C">Building - Parially Enclosed</option>
                <option value="D">Building - Open</option>
            </select>
        </div>

        <button onclick="saveLoadData_asJson('HSD_WL.json',get_WindInfo_json())">Save Data</button>
        <div id="wind-result"></div>
    </div>
    
    <div class="container">
        <h2>Seismic Load Info. 입력기</h2>
        <div class="form-group-seismic">
            <label for="codeSelect">코드선택</label>
            <select class="seismic_vals" id="codeSelect">
                <option value="NA">None Application</option>
                <option value="ASCE">ASCE 7-05</option>
                <option value="KDS">KDS 41 12 00</option>
                <option value="EN">EN1991-8</option>
            </select>
        </div>
        <div class="form-group-seismic">
            <label for="siteClass">Site Class</label>
            <select class="seismic_vals" id="siteClass">
                <option value="A">A</option>
                <option value="B">B</option>
                <option value="C">C</option>
                <option value="D">D</option>
                <option value="E">E</option>
                <option value="F">F</option>
            </select>
        </div>
        <div class="form-group-seismic">
            <label for="riskCategory">Risk Category</label>
            <select class="seismic_vals" id="riskCategory">
                <option value="1">Ⅰ</option>
                <option value="2">Ⅱ</option>
                <option value="3">Ⅲ</option>
                <option value="4">Ⅳ</option>
            </select>
        </div>
        <div class="form-group">
            <label for="rmf">Response modification factor</label>
            <blockquote>
            <div class="form-group-seismic">
                <label for="rmfLong">Longitude Side (X-axis)</label>
                <input class="seismic_vals" type="number" id="rmfLong" placeholder="Enter factor value">
            </div>
            <div class="form-group-seismic">
                <label for="rmfTrans">Transverse Side (Y-axis)</label>
                <input class="seismic_vals" type="number" id="rmfTrans" placeholder="Enter factor value">
            </div>
            </blockquote>
        </div>
        <div class="form-group">
            <label for="spectralAccelParam">Spectral acceleration parameters</label>
            <blockquote>
            <div class="form-group-seismic">
                <label for="sapSds">Sds</label>
                <input class="seismic_vals" type="number" id="sapSds" placeholder="Enter factor value">
            </div>
            <div class="form-group-seismic">
                <label for="sapSd1">Sd1</label>
                <input class="seismic_vals" type="number" id="sapSd1" placeholder="Enter factor value">
            </div>
            </blockquote>
        </div>
        

        <button onclick="saveLoadData_asJson('HSD_SL.json',get_SeismicInfo_json())">Save Data</button>
        <div id="seismic-result"></div>
    </div>
</div>
    
    <script src="js/script.js"></script>
</body>
</html>

'''
# Assign your output to the OUT variable.
OUT = htmlStr
# ----------------------------------------
code_block_43 = CodeBlock(htmlStr=make_htmlStr) { htmlStr; }
code_block_44 = CodeBlock(htmlPath=folderPath) { htmlPath; }
set_port_number_기본값_8000_작동_오류 = StringInput("8500")  # "Set Port Number: 기본값-8000 (작동 오류 없다면 변경 금지)"; graph input
code_block_45 = CodeBlock(mode=code_block_42) { mode; }
create_html_file_and_open = Python(IN[0]=code_block_43, IN[1]=code_block_44, IN[2]=set_port_number_기본값_8000_작동_오류, IN[3]=code_block_45)  # CPython3
# ---------- create_html_file_and_open.python (91 lines) ----------
# Load the Python Standard and DesignScript Libraries
import os
import sys
import clr
clr.AddReference('ProtoGeometry')
from Autodesk.DesignScript.Geometry import *

clr.AddReference('RevitNodes')
import Revit
clr.ImportExtensions(Revit.Elements)
from Revit import Elements

import time
import subprocess
import asyncio
import multiprocessing

#################################Module For Functional Programing#############################################
from functools import reduce
curry = lambda f: lambda a,*args: f(a, *args) if (len(args)) else lambda *args: f(a, *args)

filter = curry(filter)
map = curry(map)

def _take(length, iter):
    res = []
    for a in iter:
        res.append(a)
        if len(res) == length:
            return res
        
take = curry(_take)
reduce = curry(reduce)

go = lambda *args: reduce(lambda a,f: f(a), args) ## 함수도 축약 가능 ##
##############################################################################################################

# The inputs to this node will be stored as a list in the IN variables.
dataEnteringNode = IN
contents = IN[0]
folderPath = IN[1]
cwd = folderPath
portNo = IN[2]
executionMode = IN[3]
# Place your code below this line

def find_cwd():
    doc = Revit.Application.Document.Current
    filePath_string = doc.FilePath
    folderPath = filePath_string.split('\\')
    folderPath.pop(-1)
    folderPath_str = '\\'.join(folderPath)
    return folderPath_str

def make_resultHTMLname(htmlStr,title,cwd):
    #timeStamp = time.strftime('%H_%M_%S', time.localtime(time.time()))
    #folderPath = f"{cwd}\\.dynLog"
    folderPath = cwd
    if not os.path.exists(folderPath):
        os.makedirs(folderPath)
    fileName = f"index.html"
    filePath = f"{folderPath}\\" + fileName
    f = open(filePath, 'w', encoding='utf8')
    f.write(htmlStr)
    f.close()
    return fileName


def execute_browser(cwd):
    #cwd = find_cwd()
    folderPath = cwd
    os.chdir(folderPath)
    #cmdStr = "start chrome http:localhost:8000"
    cmdStr = f"start msedge http:localhost:{portNo}"
    cmdList= cmdStr.split(' ')
    #subprocess.run(args=[fileName], shell=True)
    #subprocess.run(args=['start','excel',fileName], shell=True)
    subprocess.run(args=cmdList, shell=True)
    return cmdList


#fileName = make_resultHTMLname(contents,"test",cwd)

if executionMode == "하중분배모드":
    res = 0
elif executionMode == "입력모드":
    res = execute_browser(cwd)


# Assign your output to the OUT variable.
OUT = res
# ----------------------------------------
create_js_file = Python(IN[0]=javascriptPart, IN[1]=code_block_44, IN[2]=code_block_45)  # CPython3
# ---------- create_js_file.python (86 lines) ----------
# Load the Python Standard and DesignScript Libraries
import os
import sys
import clr
clr.AddReference('ProtoGeometry')
from Autodesk.DesignScript.Geometry import *

clr.AddReference('RevitNodes')
import Revit
clr.ImportExtensions(Revit.Elements)
from Revit import Elements

import time
import subprocess

#################################Module For Functional Programing#############################################
from functools import reduce
curry = lambda f: lambda a,*args: f(a, *args) if (len(args)) else lambda *args: f(a, *args)

filter = curry(filter)
map = curry(map)

def _take(length, iter):
    res = []
    for a in iter:
        res.append(a)
        if len(res) == length:
            return res
        
take = curry(_take)
reduce = curry(reduce)

go = lambda *args: reduce(lambda a,f: f(a), args) ## 함수도 축약 가능 ##
##############################################################################################################

# The inputs to this node will be stored as a list in the IN variables.
dataEnteringNode = IN
contents = IN[0]
folderPath = IN[1]
executionMode = IN[2]
# Place your code below this line
def find_cwd():
    doc = Revit.Application.Document.Current
    filePath_string = doc.FilePath
    folderPath = filePath_string.split('\\')
    folderPath.pop(-1)
    folderPath_str = '\\'.join(folderPath)
    return folderPath_str

#cwd = find_cwd()
cwd = folderPath

def make_resultHTMLname(jsStr,cwd):
    #timeStamp = time.strftime('%H_%M_%S', time.localtime(time.time()))
    #folderPath = f"{cwd}\\.dynLog"
    folderPath = cwd
    jsPath = cwd + "\\js"
    if not os.path.exists(folderPath):
        os.makedirs(folderPath)
    if not os.path.exists(jsPath):
        os.makedirs(jsPath)
    fileName = "script.js"
    filePath = f"{jsPath}\\" + fileName
    f = open(filePath, 'w', encoding='utf8')
    f.write(jsStr)
    f.close()
    return fileName

def execute_file(fileName):
    #cwd = find_cwd()
    folderPath = cwd
    os.chdir(folderPath)
    subprocess.run(args=[fileName], shell=True)
    #subprocess.run(args=['start','excel',fileName], shell=True)
    

#fileName = make_resultHTMLname(contents,cwd)


if executionMode == "하중분배모드":
    res = 0
elif executionMode == "입력모드":
    res = make_resultHTMLname(contents,cwd)

# Assign your output to the OUT variable.
OUT = res
# ----------------------------------------
make_htmlStr_2 = Python(IN[0]=javascriptPart, IN[1]=cssPart)  # CPython3; frozen; unwired: IN[2]
# ---------- make_htmlStr_2.python (53 lines) ----------
# Load the Python Standard and DesignScript Libraries
import sys
import clr
clr.AddReference('ProtoGeometry')
from Autodesk.DesignScript.Geometry import *

# The inputs to this node will be stored as a list in the IN variables.
dataEnteringNode = IN
jsPart = IN[0]
cssPart = IN[1]
tablePart = IN[2]

# Place your code below this line
##folderPath_r = folderPath.replace('\\','\\\\')

htmlStr = f'''
<!DOCTYPE html>
<html lang="ko">

<head>
    <meta charset="UTF-8">
    <title>my first three.js app</title>
    <style>
        {cssPart}
    </style>
</head>

<body>


<div class="wrapper">

  <a data-fslightbox="gallery" href="#custom-source">
    유튜브 라이트박스
  </a>

  <iframe id="custom-source"
          frameborder="0"
          width="1920px"
          height="1080px"
          allow="autoplay; fullscreen"
          src="https://www.youtube.com/embed/qgBSiRwsbNw?autoplay=1">
  </iframe>
</div>

<script src="https://cdnjs.cloudflare.com/ajax/libs/fslightbox/3.3.1/index.min.js" integrity="sha512-EqNNJuepkw5P9vxCml8eBk7C4Ld+4kAnvzOD/jG21rkxWPILGoQa5EvD62UieiJF0u3xoQrcVnce4i83VnYj/Q==" crossorigin="anonymous" referrerpolicy="no-referrer"></script>

</body>

</html>
'''
# Assign your output to the OUT variable.
OUT = htmlStr
# ----------------------------------------
start_webserver = Python(IN[0]=code_block_44, IN[1]=set_port_number_기본값_8000_작동_오류, IN[2]=code_block_45)  # CPython3
# ---------- start_webserver.python (54 lines) ----------
# Load the Python Standard and DesignScript Libraries
import sys
import clr
clr.AddReference('ProtoGeometry')
from Autodesk.DesignScript.Geometry import *

import os
import asyncio
import multiprocessing
import subprocess
# The inputs to this node will be stored as a list in the IN variables.
dataEnteringNode = IN
cwd = IN[0]
portNo = IN[1]
executionMode = IN[2]
# Place your code below this line
batStr = f"""
@echo on
python -m http.server {portNo}
cmd /k
"""
##cmd /k
title = "localWebserver"

def make_startSever_bat(batStr,title,cwd):
    folderPath = cwd
    if not os.path.exists(folderPath):
        os.makedirs(folderPath)
    fileName = f"{title}.bat"
    filePath = f"{folderPath}\\" + fileName
    f = open(filePath, 'w', encoding='utf8')
    f.write(batStr)
    f.close()
    return fileName

def startBat(fileName, cwd):
    cmdStr = f".\\{fileName}"
    cmdList= cmdStr.split(' ')
    os.chdir(cwd)
    
    res = subprocess.Popen(args=cmdList, shell=True)
    return res

batFileName = make_startSever_bat(batStr,title,cwd)

if executionMode == "하중분배모드":
    res = 0
elif executionMode == "입력모드":
    res = startBat(batFileName, cwd)

# Assign your output to the OUT variable.
OUT = res

#startBat(fileName, cwd)
# ----------------------------------------

serverFilePath = CodeBlock { ".dynTempServer"; }
htmlPath = Python(IN[0]=serverFilePath)  # CPython3; frozen
# ---------- htmlPath.python (34 lines) ----------
# Load the Python Standard and DesignScript Libraries
import sys
import clr
clr.AddReference('ProtoGeometry')
from Autodesk.DesignScript.Geometry import *
import time
import subprocess
import os

clr.AddReference('RevitNodes')
import Revit
clr.ImportExtensions(Revit.Elements)
from Revit import Elements
# The inputs to this node will be stored as a list in the IN variables.
dataEnteringNode = IN
dynTempServerPath = IN[0]
# Place your code below this line
def find_cwd():
    doc = Revit.Application.Document.Current
    filePath_string = doc.FilePath
    folderPath = filePath_string.split('\\')
    folderPath.pop(-1)
    folderPath_str = '\\'.join(folderPath)
    return folderPath_str

#cwd = find_cwd()
cwd = os.getenv("HomePath")

folderPath = f"{cwd}\\{dynTempServerPath}"
if not os.path.exists(folderPath):
    os.makedirs(folderPath)

# Assign your output to the OUT variable.
OUT = "C:"+folderPath
# ----------------------------------------
