# Dynamo graph 공통_Load Distribution.dyn "#&Load Distribution" (Dynamo 2.16.1.2727)

categories = Categories("OST_StructuralFraming")
all_elements_of_category = ElementsOfCategory(Category=categories)
code_block = CodeBlock { "Reference Level"; }
getParameterValueByName = Element.GetParameterValueByName(element=all_elements_of_category, parameterName=code_block)
getLocation = Element.GetLocation(element=all_elements_of_category)
startPoint = Curve.StartPoint(curve=getLocation)
Z = Point.Z(point=startPoint)
minimumItem = List.MinimumItem(list=Z)
geometry = Element.Geometry(element=all_elements_of_category)
flatten = List.Flatten(list=geometry)
findSolidUpperSrfPoint = Python(IN[0]=flatten)  # CPython3; starter script, not edited (OUT = 0)
rooms_by_status = RoomsByStatus()
coreCenterBoundary = Room.CoreCenterBoundary(room=rooms_by_status.PlacedRooms)
byJoinedCurves = PolyCurve.ByJoinedCurves(curves=coreCenterBoundary)
flatten_2 = List.Flatten(list=byJoinedCurves)
byPatch = Surface.ByPatch(closedCurve=flatten_2)
maximumItem = List.MaximumItem(list=Z)
code_block_2 = CodeBlock { 0; }
pointAtParameter = Surface.PointAtParameter(surface=byPatch, u=code_block_2, v=code_block_2)
Z_2 = Point.Z(point=pointAtParameter)
maximumItem_2 = List.MaximumItem(list=Z_2)
sub = maximumItem - maximumItem_2
translate = Geometry.Translate(geometry=byPatch, zTranslation=sub)
code_block_3 = CodeBlock { -100; }
extendStart = Curve.ExtendStart(curve=getLocation, distance=code_block_3)
extendEnd = Curve.ExtendEnd(curve=extendStart, distance=code_block_3)
integer_slider = IntegerSlider(42, range=0..78 step 1)
code_block_4 = CodeBlock(i=extendEnd, j=integer_slider) { i[j]; }
# note: beam으로 둘러쌓인 구간을 spanSrf로 규정하고,
# spanSrf에 속하는 각 빔1,2,3,4 를 저장하고
# 각 빔에 달라붙을 spanSrfSegment를 만들어준다.
# (1-way slab의 경우 단축의 중점을 기준으로 2개로 스플릿
# 2-way slab의 경우 꼭지점 45도 작도법으로 각 빔당 spanSrfSegment 작성후 배정)
# spanSrf와 교차하는 각 룸의 영역과 그 룸의 단위면적당 하중을 저장하고
# 그영역에 해당하는 전체 하중 계산후 각 빔에 분배계수로 나눠준다
doesIntersect = Geometry.DoesIntersect(geometry=code_block_4, other=translate)
filterByBoolMask = List.FilterByBoolMask(list=translate, mask=doesIntersect)
code_block_5 = CodeBlock(i=filterByBoolMask.in) { i; }
perimeterCurves = Surface.PerimeterCurves(surface=code_block_5)
parameters = Element.Parameters(element=rooms_by_status.PlacedRooms)
byJoinedSurfaces = PolySurface.ByJoinedSurfaces(surfaces=translate)
code_block_6 = CodeBlock(frameLocs=getLocation) { frameLocs; }
split = Geometry.Split(geometry=byJoinedSurfaces, other=code_block_6)
code_block_7 = CodeBlock(i=split) { i[0]; }
perimeterCurves_2 = Surface.PerimeterCurves(surface=code_block_7)
groupByKey = List.GroupByKey(list=getLocation, keys=Z)
find_closed_loop = Python(IN[0]=groupByKey.groups)  # CPython3
# ---------- find_closed_loop.python (65 lines) ----------
# Load the Python Standard and DesignScript Libraries
import sys
import clr
clr.AddReference('ProtoGeometry')
from Autodesk.DesignScript.Geometry import *

from copy import deepcopy
from itertools import groupby
from itertools import chain
#################################Module For Functional Programing#############################################
from functools import reduce
curry = lambda f: lambda a,*args: f(a, *args) if (len(args)) else lambda *args: f(a, *args)

filter = curry(filter)
map = curry(map)

def _take(length, iter):
    res = []
    for a in iter:
        res.append(a)
        if len(res) == length:
            return res
        
take = curry(_take)
reduce = curry(reduce)

go = lambda *args: reduce(lambda a,f: f(a), args) ## 함수도 축약 가능 ##
##############################################################################################################
# The inputs to this node will be stored as a list in the IN variables.
dataEnteringNode = IN
frameLocs_perLevel = IN[0][1]
# Place your code below this line

def sort_ByDirection(col, func):
    res = sorted(col, key = func)
    
    return res

def find_closed(locs):
    res = []
    #tgtList = deepcopy(locs)
    for i in locs:       
        primeIntsct = go\
        (   
            locs,
            filter( lambda x: i != x ),
            filter( lambda x: i.DoesIntersect(x) ),
            filter( lambda x: not(i.Direction.IsParallel(x.Direction)) ),
            map( lambda x: x.Length ),
            list,
#            map( lambda x: [x.StartPoint, x.EndPoint] ),
#            lambda x: list(chain(*x)),
#            set,
        )
        #srf = i.Extrude(round(primeIntsct[0]))
        #primeIntsct.insert(0,i)
        

        #res.append(srf)
        res.append(round(primeIntsct[0]))
    return res
            
# Assign your output to the OUT variable.
#OUT = sort_ByDirection(frameLocs_perLevel, lambda x: [round(x.Direction.X), round(x.Direction.Y)])
OUT = find_closed(frameLocs_perLevel)
# ----------------------------------------
code_block_8 = CodeBlock(i=find_closed_loop) { i[23]; }
isAlmostEqualTo = Geometry.IsAlmostEqualTo(geometry=code_block_8, other=code_block_8, lacing=CrossProduct)
perimeterCurves_3 = Surface.PerimeterCurves(surface=find_closed_loop)
code_block_9 = CodeBlock(i=groupByKey.groups) { i[1]; }
extrude = Curve.Extrude(curve=code_block_9, distance=find_closed_loop)
code_block_10 = CodeBlock(i=extrude) { i[46]; }
perimeterCurves_4 = Surface.PerimeterCurves(surface=find_closed_loop)
firstItem = List.FirstItem(list=find_closed_loop@L2)
