# Dynamo graph assem_stair_destruct_test.dyn (Dynamo 3.3.0.6316)
# author: MK Jang
# Auto Calculating the Quantities of each Element As per the Family List

# group: All Elements in Revit
categories = Categories("OST_Rooms")
all_elements_of_category = ElementsOfCategory(Category=categories)
list_create = List.Create(item0=all_elements_of_category)
categories_2 = Categories("OST_Gutter")
all_elements_of_category_2 = ElementsOfCategory(Category=categories_2)
list_create_2 = List.Create(item0=all_elements_of_category_2)
all_elementsexceptrails = Python()  # CPython3; unwired: IN[0]
# ---------- all_elementsexceptrails.python (51 lines) ----------
# Load the Python Standard and DesignScript Libraries
import sys
import clr
clr.AddReference('ProtoGeometry')
from Autodesk.DesignScript.Geometry import *

clr.AddReference('RevitAPI')
from Autodesk.Revit.DB import *
import Autodesk

clr.AddReference('RevitServices')
import RevitServices
from RevitServices.Persistence import DocumentManager
doc = DocumentManager.Instance.CurrentDBDocument

def get_all_BIC():

    db = [
    Autodesk.Revit.DB.BuiltInCategory.OST_Floors,
    Autodesk.Revit.DB.BuiltInCategory.OST_Roofs,
    Autodesk.Revit.DB.BuiltInCategory.OST_Walls,
    Autodesk.Revit.DB.BuiltInCategory.OST_StructuralFoundation,
    Autodesk.Revit.DB.BuiltInCategory.OST_StructuralColumns,
    Autodesk.Revit.DB.BuiltInCategory.OST_StructuralFraming,
    Autodesk.Revit.DB.BuiltInCategory.OST_Ceilings,
    Autodesk.Revit.DB.BuiltInCategory.OST_Doors,
    Autodesk.Revit.DB.BuiltInCategory.OST_Windows,
    Autodesk.Revit.DB.BuiltInCategory.OST_Stairs,
    #Autodesk.Revit.DB.BuiltInCategory.OST_Railings,
    ]
    return db
    
def get_allElems(doc):
    bics = get_all_BIC()
    
    def getElems(x):
        collector = FilteredElementCollector(doc)
        res = collector.OfCategory(x).WhereElementIsNotElementType().ToElements()
        return res

    def getRailElems(x):
        collector = FilteredElementCollector(doc)
        res = collector.OfCategory(x).WhereElementIsNotElementType()
        return res

    res = map(getElems, bics)
#    res = getRailElems(Autodesk.Revit.DB.BuiltInCategory.OST_RailingSystemRail)
    return res


OUT = get_allElems(doc)
# ----------------------------------------
categories_3 = Categories("OST_EdgeSlab")
all_elements_of_category_3 = ElementsOfCategory(Category=categories_3)
list_create_3 = List.Create(item0=all_elements_of_category_3)
categories_4 = Categories("OST_StairsRailing")
all_elements_of_category_4 = ElementsOfCategory(Category=categories_4)
list_create_4 = List.Create(item0=all_elements_of_category_4)
categories_5 = Categories("OST_GenericModel")
all_elements_of_category_5 = ElementsOfCategory(Category=categories_5)
type = Object.Type(object=all_elements_of_category_5)
code_block = CodeBlock(i=type) { i!="Revit.Elements.DirectShape"; }
filterByBoolMask = List.FilterByBoolMask(list=all_elements_of_category_5, mask=code_block)
list_create_5 = List.Create(item0=filterByBoolMask.in)
join = List.Join(list0=list_create, list1=list_create_2, list2=all_elementsexceptrails, list3=list_create_3, list4=list_create_4, list5=list_create_5)

categories_6 = Categories("OST_Stairs")
all_elements_of_category_6 = ElementsOfCategory(Category=categories_6)
code_block_2 = CodeBlock(i=all_elements_of_category_6) { i[0]; }
parameters = Element.Parameters(element=code_block_2)
code_block_3 = CodeBlock { "Family and Type"; }
getParameterValueByName = Element.GetParameterValueByName(element=code_block_2, parameterName=code_block_3)
parameters_2 = Element.Parameters(element=getParameterValueByName)
solids = Element.Solids(element=code_block_2)
code_block_4 = CodeBlock(i=solids) { i[11]; }
categories_7 = Categories("OST_StairsLandings")
all_elements_of_category_7 = ElementsOfCategory(Category=categories_7)
parameters_3 = Element.Parameters(element=all_elements_of_category_7)
solids_2 = Element.Solids(element=all_elements_of_category_7)
랜딩_추출_예시 = Python(IN[0]=code_block_2)  # CPython3
# ---------- 랜딩_추출_예시.python (28 lines) ----------
import clr
clr.AddReference('RevitAPI')
from Autodesk.Revit.DB import *
from Autodesk.Revit.DB import Solid, Face, PlanarFace

stairs = UnwrapElement(IN[0])
doc = stairs.Document
options = Options()
total_area_m2 = 0.0

# 1. Get landing elements
landing_ids = stairs.GetStairsLandings()
landings = [doc.GetElement(lid) for lid in landing_ids]

# 2. Loop through each landing geometry
for landing in landings:
    geom = landing.get_Geometry(options)
    for solid in geom:
        if not isinstance(solid, Solid):
            continue
        for face in solid.Faces:
            # 3. Only use horizontal (upward-facing) planar faces
            if isinstance(face, PlanarFace):
                normal = face.FaceNormal
                if abs(normal.Z - 1.0) < 0.01:  # Z+ 방향이면 수평면
                    total_area_m2 += face.Area * 0.092903  # ft² → m²

OUT = total_area_m2
# ----------------------------------------
stringer_추출_예시 = Python(IN[0]=code_block_2)  # CPython3
# ---------- stringer_추출_예시.python (23 lines) ----------
import clr
clr.AddReference('RevitAPI')
from Autodesk.Revit.DB import *

stairs = UnwrapElement(IN[0])
doc = stairs.Document
options = Options()

support_ids = stairs.GetStairsSupports()  # ✅ 스트링거 ID 목록 추출
total_area_ft2 = 0.0

for sid in support_ids:
    support = doc.GetElement(sid)
    geom = support.get_Geometry(options)
    for solid in geom:
        if hasattr(solid, "Faces"):
            for face in solid.Faces:
                total_area_ft2 += face.Area

# 단위 변환
total_area_m2 = total_area_ft2 * 0.092903

OUT = total_area_m2
# ----------------------------------------
