# Dynamo graph localWebserverStart_1.0.0.dyn (Dynamo 2.16.1.2727)

htmlPath = Python()  # CPython3; unwired: IN[0]
# ---------- htmlPath.python (33 lines) ----------
# Load the Python Standard and DesignScript Libraries
import sys
import clr
clr.AddReference('ProtoGeometry')
from Autodesk.DesignScript.Geometry import *
import time
import subprocess
import os

clr.AddReference('RevitNodes')
import Revit
clr.ImportExtensions(Revit.Elements)
from Revit import Elements
# The inputs to this node will be stored as a list in the IN variables.
dataEnteringNode = IN

# Place your code below this line
def find_cwd():
    doc = Revit.Application.Document.Current
    filePath_string = doc.FilePath
    folderPath = filePath_string.split('\\')
    folderPath.pop(-1)
    folderPath_str = '\\'.join(folderPath)
    return folderPath_str

cwd = find_cwd()

folderPath = f"{cwd}\\.dynLog"
if not os.path.exists(folderPath):
    os.makedirs(folderPath)

# Assign your output to the OUT variable.
OUT = folderPath
# ----------------------------------------
start_webserver = Python(IN[0]=htmlPath)  # CPython3
# ---------- start_webserver.python (47 lines) ----------
# Load the Python Standard and DesignScript Libraries
import sys
import clr
clr.AddReference('ProtoGeometry')
from Autodesk.DesignScript.Geometry import *

import os
import asyncio
import multiprocessing
import subprocess
# The inputs to this node will be stored as a list in the IN variables.
dataEnteringNode = IN
cwd = IN[0]
# Place your code below this line
batStr = """
@echo on
python -m http.server
cmd /k
"""
##cmd /k
title = "localWebserver"

def make_startSever_bat(batStr,title,cwd):
    folderPath = cwd
    if not os.path.exists(folderPath):
        os.makedirs(folderPath)
    fileName = f"{title}.bat"
    filePath = f"{folderPath}\\" + fileName
    f = open(filePath, 'w', encoding='utf8')
    f.write(batStr)
    f.close()
    return fileName

def startBat(fileName, cwd):
    cmdStr = f".\\{fileName}"
    cmdList= cmdStr.split(' ')
    os.chdir(cwd)
    
    res = subprocess.Popen(args=cmdList, shell=True)
    return res

batFileName = make_startSever_bat(batStr,title,cwd)
#res = multiprocessing.Process(name="SubProcess", target=startBat, args=(batFileName, cwd))
# Assign your output to the OUT variable.
OUT = startBat(batFileName, cwd)

#startBat(fileName, cwd)
# ----------------------------------------
watch = Watch(start_webserver)  # graph output
