# Dynamo graph test1.dyn (Dynamo 2.16.1.2727)

categories = Categories("OST_StructuralFoundation")
all_elements_of_category = ElementsOfCategory(Category=categories)
watch = Watch(all_elements_of_category)
parameters = Element.Parameters(element=all_elements_of_category)

# group: 패밀리 타입 필터링
code_block = CodeBlock(i=all_elements_of_category) { i; }
name = Element.Name(element=code_block)
code_block_2 = CodeBlock { "S18_"; }
contains = String.Contains(string=name, searchFor=code_block_2)
filterByBoolMask = List.FilterByBoolMask(list=code_block, mask=contains)

watch_2 = Watch(filterByBoolMask.in)
parameters_2 = Element.Parameters(element=watch_2)

# group: 1. 기초 체적 산출 구간
code_block_3 = CodeBlock { "Volume"; }
getParameterValueByName = Element.GetParameterValueByName(element=watch_2, parameterName=code_block_3)

# group: 2. 기초 측면 산출 구간
geometry = Element.Geometry(element=watch_2)
flatten = List.Flatten(list=geometry)
explode = Geometry.Explode(geometry=flatten)
normalAtParameter = Surface.NormalAtParameter(surface=explode)
Z = Vector.Z(vector=normalAtParameter)
code_block_4 = CodeBlock { 2; }
round = Math.Round(number=Z, digits=code_block_4)
code_block_5 = CodeBlock(i=round) { i==0; }
filterByBoolMask_2 = List.FilterByBoolMask(list=explode, mask=code_block_5)
code_block_6 = CodeBlock(i=filterByBoolMask_2.in) { i; }
area = Surface.Area(surface=code_block_6)
sum = Math.Sum(values=area)
code_block_7 = CodeBlock { 1000000; }
div = sum / code_block_7
code_block_8 = CodeBlock { 2; }
round_2 = Math.Round(number=div, digits=code_block_8)
sum_2 = Math.Sum(values=round_2)

categories_2 = Categories("OST_StructuralFraming")
all_elements_of_category_2 = ElementsOfCategory(Category=categories_2)

# group: 3. 빔거더 체적 산출 구간
code_block_9 = CodeBlock { "Volume"; }
getParameterValueByName_2 = Element.GetParameterValueByName(element=all_elements_of_category_2, parameterName=code_block_9)

# group: 4. 빔거더 거푸집 면적 산출 구간
geometry_2 = Element.Geometry(element=all_elements_of_category_2)

flatten_2 = List.Flatten(list=geometry_2)
explode_2 = Geometry.Explode(geometry=flatten_2)
normalAtParameter_2 = Surface.NormalAtParameter(surface=explode_2)
Z_2 = Vector.Z(vector=normalAtParameter_2)
code_block_10 = CodeBlock { 2; }
round_3 = Math.Round(number=Z_2, digits=code_block_10)
code_block_11 = CodeBlock(i=round_3) { i!=1; }
filterByBoolMask_3 = List.FilterByBoolMask(list=explode_2, mask=code_block_11)
code_block_12 = CodeBlock(i=filterByBoolMask_3.in) { i; }
area_2 = Surface.Area(surface=code_block_12)
sum_3 = Math.Sum(values=area_2)
code_block_13 = CodeBlock { 1000000; }
div_2 = sum_3 / code_block_13
code_block_14 = CodeBlock { 2; }
round_4 = Math.Round(number=div_2, digits=code_block_14)
