# Dynamo graph test2.dyn (Dynamo 2.16.1.2727)

categories = Categories("OST_StructuralColumns")
all_elements_of_category = ElementsOfCategory(Category=categories)
name = Element.Name(element=all_elements_of_category)
code_block = CodeBlock { "PED"; }
contains = String.Contains(string=name, searchFor=code_block)
filterByBoolMask = List.FilterByBoolMask(list=all_elements_of_category, mask=contains)
code_block_2 = CodeBlock(i=filterByBoolMask.out) { i; }
geometry = Element.Geometry(element=code_block_2)
parameters = Element.Parameters(element=code_block_2)
code_block_3 = CodeBlock { "Length"; }
getParameterValueByName = Element.GetParameterValueByName(element=code_block_2, parameterName=code_block_3)

# group: 길이 단위 수정
code_block_4 = CodeBlock { 1000; }
div = getParameterValueByName / code_block_4

code_block_5 = CodeBlock { "Family and Type"; }
getParameterValueByName_2 = Element.GetParameterValueByName(element=code_block_2, parameterName=code_block_5)
code_block_6 = CodeBlock { "Nominal Weight"; }
getParameterValueByName_3 = Element.GetParameterValueByName(element=getParameterValueByName_2, parameterName=code_block_6)
mul = div * getParameterValueByName_3

# group: 무게단위 수정
code_block_7 = CodeBlock { 1000; }
div_2 = mul / code_block_7

code_block_8 = CodeBlock { "Exact Weight"; }
getParameterValueByName_4 = Element.GetParameterValueByName(element=code_block_2, parameterName=code_block_8)
