# Dynamo graph 계단 길이 산출 테스트.dyn (Dynamo 3.3.0.6316)

select_model_element = DSModelElementSelection()  # 1 picked in the model
스트링거_길이_평균 = Python(IN[0]=select_model_element)  # CPython3
# ---------- 스트링거_길이_평균.python (37 lines) ----------
import clr
clr.AddReference('RevitAPI')
from Autodesk.Revit.DB import *

clr.AddReference('RevitServices')
from RevitServices.Persistence import DocumentManager

doc = DocumentManager.Instance.CurrentDBDocument
stairs = UnwrapElement(IN[0])  # 계단 요소

total_length = 0.0

# 스트링거(서포트) 요소 ID들
support_ids = stairs.GetStairsSupports()

for sid in support_ids:
    support = doc.GetElement(sid)
    if support is None:
        continue

    # Geometry에서 길이 추출
    opts = Options()
    geom = support.get_Geometry(opts)
    for g in geom:
        if isinstance(g, Solid):
            for edge in g.Edges:
                total_length += edge.ApproximateLength
        elif isinstance(g, Curve):
            total_length += g.Length

# 바깥쪽 스트링거 길이 추정 (2개 기준)
outer_stringer_length = total_length / 2.0

# 피트 → 미터 변환
length_m = outer_stringer_length * 0.3048

OUT = length_m
# ----------------------------------------
랜딩_길이 = Python(IN[0]=select_model_element)  # CPython3
# ---------- 랜딩_길이.python (35 lines) ----------
import clr
clr.AddReference('RevitAPI')
from Autodesk.Revit.DB import *

clr.AddReference('RevitServices')
from RevitServices.Persistence import DocumentManager

doc = DocumentManager.Instance.CurrentDBDocument
stairs = UnwrapElement(IN[0])  # Stairs element

total_short_length = 0.0

# 계단의 랜딩(landing) 요소들 가져오기
landing_ids = stairs.GetStairsLandings()

for lid in landing_ids:
    landing = doc.GetElement(lid)
    if landing is None:
        continue

    bbox = landing.get_BoundingBox(doc.ActiveView)
    if bbox is None:
        continue

    # XYZ 빼기 연산은 직접 안 되므로 축별로 처리
    dx = abs(bbox.Max.X - bbox.Min.X)
    dy = abs(bbox.Max.Y - bbox.Min.Y)

    short_len = min(dx, dy)
    total_short_length += short_len

# 단위: 피트 → 미터
total_short_length_m = total_short_length * 0.3048

OUT = total_short_length_m
# ----------------------------------------
런_길이 = Python(IN[0]=select_model_element)  # CPython3
# ---------- 런_길이.python (46 lines) ----------
import clr
clr.AddReference('RevitAPI')
from Autodesk.Revit.DB import *

clr.AddReference('RevitServices')
from RevitServices.Persistence import DocumentManager

import math

doc = DocumentManager.Instance.CurrentDBDocument
stairs = UnwrapElement(IN[0])  # Stairs instance

total_run_length = 0.0

run_ids = stairs.GetStairsRuns()

for rid in run_ids:
    run = doc.GetElement(rid)
    if run is None:
        continue

    # ✅ 파라미터로 접근
    riser_param = run.LookupParameter("Actual Riser Height")
    tread_param = run.LookupParameter("Actual Tread Depth")
    treads_param = run.LookupParameter("Actual Number of Treads")

    if not (riser_param and tread_param and treads_param):
        continue

    if not (riser_param.HasValue and tread_param.HasValue and treads_param.HasValue):
        continue

    # 파라미터 값 추출
    riser_height = riser_param.AsDouble()
    tread_depth = tread_param.AsDouble()
    num_treads = treads_param.AsInteger()

    # 러닝 길이 = 대각선 길이 × 단수
    step_length = math.sqrt(riser_height**2 + tread_depth**2)
    run_length = step_length * num_treads
    total_run_length += run_length

# 단위 변환: 피트 → 미터
total_run_length_m = total_run_length * 0.3048

OUT = total_run_length_m
# ----------------------------------------
