# Dynamo graph 공통_Load Distribution_1.0.0.dyn (Dynamo 2.16.1.2727)

rooms_by_status = RoomsByStatus()
coreCenterBoundary = Room.CoreCenterBoundary(room=rooms_by_status.PlacedRooms)
byJoinedCurves = PolyCurve.ByJoinedCurves(curves=coreCenterBoundary)
categories = Categories("OST_StructuralFraming")
all_elements_of_category = ElementsOfCategory(Category=categories)
code_block = CodeBlock { "Reference Level"; }
getParameterValueByName = Element.GetParameterValueByName(element=all_elements_of_category, parameterName=code_block)
parameters = Element.Parameters(element=rooms_by_status.PlacedRooms)
find_closed_loop = Python()  # CPython3; frozen; unwired: IN[0]
# ---------- find_closed_loop.python (65 lines) ----------
# Load the Python Standard and DesignScript Libraries
import sys
import clr
clr.AddReference('ProtoGeometry')
from Autodesk.DesignScript.Geometry import *

from copy import deepcopy
from itertools import groupby
from itertools import chain
#################################Module For Functional Programing#############################################
from functools import reduce
curry = lambda f: lambda a,*args: f(a, *args) if (len(args)) else lambda *args: f(a, *args)

filter = curry(filter)
map = curry(map)

def _take(length, iter):
    res = []
    for a in iter:
        res.append(a)
        if len(res) == length:
            return res
        
take = curry(_take)
reduce = curry(reduce)

go = lambda *args: reduce(lambda a,f: f(a), args) ## 함수도 축약 가능 ##
##############################################################################################################
# The inputs to this node will be stored as a list in the IN variables.
dataEnteringNode = IN
frameLocs_perLevel = IN[0][1]
# Place your code below this line

def sort_ByDirection(col, func):
    res = sorted(col, key = func)
    
    return res

def find_closed(locs):
    res = []
    #tgtList = deepcopy(locs)
    for i in locs:       
        primeIntsct = go\
        (   
            locs,
            filter( lambda x: i != x ),
            filter( lambda x: i.DoesIntersect(x) ),
            filter( lambda x: not(i.Direction.IsParallel(x.Direction)) ),
            map( lambda x: x.Length ),
            list,
#            map( lambda x: [x.StartPoint, x.EndPoint] ),
#            lambda x: list(chain(*x)),
#            set,
        )
        #srf = i.Extrude(round(primeIntsct[0]))
        #primeIntsct.insert(0,i)
        

        #res.append(srf)
        res.append(round(primeIntsct[0]))
    return res
            
# Assign your output to the OUT variable.
#OUT = sort_ByDirection(frameLocs_perLevel, lambda x: [round(x.Direction.X), round(x.Direction.Y)])
OUT = find_closed(frameLocs_perLevel)
# ----------------------------------------
explode = Geometry.Explode()  # unwired: geometry
categories_2 = Categories("OST_StructuralColumns")
all_elements_of_category_2 = ElementsOfCategory(Category=categories_2)
parameters_2 = Element.Parameters(element=all_elements_of_category_2)
제외단면 = StringInput("W200xL200")
filterAGCols = Python(IN[0]=all_elements_of_category_2, IN[1]=제외단면)  # CPython3
# ---------- filterAGCols.python (43 lines) ----------
# Load the Python Standard and DesignScript Libraries
import sys
import clr
clr.AddReference('ProtoGeometry')
from Autodesk.DesignScript.Geometry import *

#################################Module For Functional Programing#############################################
from functools import reduce
curry = lambda f: lambda a,*args: f(a, *args) if (len(args)) else lambda *args: f(a, *args)

filter = curry(filter)
map = curry(map)

def _take(length, iter):
    res = []
    for a in iter:
        res.append(a)
        if len(res) == length:
            return res
        
take = curry(_take)
reduce = curry(reduce)

go = lambda *args: reduce(lambda a,f: f(a), args) ## 함수도 축약 가능 ##
##############################################################################################################

# The inputs to this node will be stored as a list in the IN variables.
dataEnteringNode = IN
cols = IN[0]
exceptionRule = IN[1]
# Place your code below this line

def getColumnCrv(els):
    res = go\
    (
        els,
        filter(lambda x: "UG PED" not in str(x.GetParameterValueByName("Family and Type"))),
        filter(lambda x: exceptionRule not in str(x.GetParameterValueByName("Family and Type"))),
    )
    
    return res
# Assign your output to the OUT variable.
OUT = getColumnCrv(cols)
# ----------------------------------------
getColumnCrv = Python(IN[0]=filterAGCols)  # CPython3
# ---------- getColumnCrv.python (43 lines) ----------
# Load the Python Standard and DesignScript Libraries
import sys
import clr
clr.AddReference('ProtoGeometry')
from Autodesk.DesignScript.Geometry import *

#################################Module For Functional Programing#############################################
from functools import reduce
curry = lambda f: lambda a,*args: f(a, *args) if (len(args)) else lambda *args: f(a, *args)

filter = curry(filter)
map = curry(map)

def _take(length, iter):
    res = []
    for a in iter:
        res.append(a)
        if len(res) == length:
            return res
        
take = curry(_take)
reduce = curry(reduce)

go = lambda *args: reduce(lambda a,f: f(a), args) ## 함수도 축약 가능 ##
##############################################################################################################

# The inputs to this node will be stored as a list in the IN variables.
dataEnteringNode = IN
cols = IN[0]
# Place your code below this line

def getColumnCrv(el):
    sttPt = el.GetLocation()
    endPt = go\
    (
        el,
        lambda x: x.GetLocation(),
        lambda x: x.Translate(0,0, el.GetParameterValueByName("Length")),
    )
    
    return Line.ByStartPointEndPoint(sttPt,endPt)
# Assign your output to the OUT variable.
OUT = map(getColumnCrv,cols)
# ----------------------------------------
select_model_element_by_category = DSModelElementByCategorySelection("OST_Roofs")  # 1 picked in the model
geometry = Element.Geometry(element=select_model_element_by_category)
getBottomCrv = Python(IN[0]=geometry)  # CPython3
# ---------- getBottomCrv.python (43 lines) ----------
# Load the Python Standard and DesignScript Libraries
import sys
import clr
clr.AddReference('ProtoGeometry')
from Autodesk.DesignScript.Geometry import *

#################################Module For Functional Programing#############################################
from functools import reduce
curry = lambda f: lambda a,*args: f(a, *args) if (len(args)) else lambda *args: f(a, *args)

filter = curry(filter)
map = curry(map)

def _take(length, iter):
    res = []
    for a in iter:
        res.append(a)
        if len(res) == length:
            return res
        
take = curry(_take)
reduce = curry(reduce)

go = lambda *args: reduce(lambda a,f: f(a), args) ## 함수도 축약 가능 ##
##############################################################################################################

# The inputs to this node will be stored as a list in the IN variables.
dataEnteringNode = IN
geo = IN[0][0]
# Place your code below this line

def getBtmCrvs(geo):
    btmSrf = go\
    (
        geo.Explode(),
        filter(lambda x:round(x.NormalAtParameter(0.5,0.5).Z, 4)==-1),
        list,
        lambda x: x[0].PerimeterCurves(),
    )
    
    return btmSrf
# Assign your output to the OUT variable.
OUT = getBtmCrvs(geo)
# ----------------------------------------
byJoinedCurves_2 = PolyCurve.ByJoinedCurves(curves=getBottomCrv)
byPatch = Surface.ByPatch(closedCurve=byJoinedCurves_2)
getLocation = Element.GetLocation(element=all_elements_of_category)
startPoint = Curve.StartPoint(curve=getLocation)
Z = Point.Z(point=startPoint)
code_block_2 = CodeBlock { 0; }
round = Math.Round(number=Z, digits=code_block_2)
groupByKey = List.GroupByKey(list=all_elements_of_category, keys=round)
code_block_3 = CodeBlock(i=groupByKey.groups) { i[1]; }
getLocation_2 = Element.GetLocation(element=code_block_3)
direction = Line.Direction(line=getLocation_2)
normalized = Vector.Normalized(vector=direction)
getXYZ = Python(IN[0]=normalized)  # CPython3
# ---------- getXYZ.python (42 lines) ----------
# Load the Python Standard and DesignScript Libraries
import sys
import clr
clr.AddReference('ProtoGeometry')
from Autodesk.DesignScript.Geometry import *

#################################Module For Functional Programing#############################################
from functools import reduce
curry = lambda f: lambda a,*args: f(a, *args) if (len(args)) else lambda *args: f(a, *args)

filter = curry(filter)
map = curry(map)

def _take(length, iter):
    res = []
    for a in iter:
        res.append(a)
        if len(res) == length:
            return res
        
take = curry(_take)
reduce = curry(reduce)

go = lambda *args: reduce(lambda a,f: f(a), args) ## 함수도 축약 가능 ##
##############################################################################################################

# The inputs to this node will be stored as a list in the IN variables.
dataEnteringNode = IN
vecs = IN[0]
# Place your code below this line

def getXYZ(vecs):
    res = go\
    (
        vecs,
        map(lambda x: (round(x.X), round(x.Y), round(x.Z))),
        map(str),
    )
    
    return res
# Assign your output to the OUT variable.
OUT = getXYZ(vecs)
# ----------------------------------------
firstItem = List.FirstItem(list=normalized)
isParallel = Vector.IsParallel(vector=firstItem, otherVector=normalized)
groupByKey_2 = List.GroupByKey(list=getLocation_2, keys=isParallel)
code_block_4 = CodeBlock(i=groupByKey_2.groups) { i[0]; }
startPoint_2 = Curve.StartPoint(curve=code_block_4)
X = Point.X(point=startPoint_2)
groupByKey_3 = List.GroupByKey(list=code_block_4, keys=X)
code_block_5 = CodeBlock(i=groupByKey_2.groups) { i[1]; }
startPoint_3 = Curve.StartPoint(curve=code_block_5)
X_2 = Point.X(point=startPoint_3)
groupByKey_4 = List.GroupByKey(list=code_block_5, keys=X_2)
getClosedCrv = Python(IN[0]=groupByKey_3.groups, IN[1]=groupByKey_4.groups)  # CPython3
# ---------- getClosedCrv.python (66 lines) ----------
# Load the Python Standard and DesignScript Libraries
import sys
import clr
clr.AddReference('ProtoGeometry')
from Autodesk.DesignScript.Geometry import *

#################################Module For Functional Programing#############################################
from functools import reduce
curry = lambda f: lambda a,*args: f(a, *args) if (len(args)) else lambda *args: f(a, *args)

filter = curry(filter)
map = curry(map)

def _take(length, iter):
    res = []
    for a in iter:
        res.append(a)
        if len(res) == length:
            return res
        
take = curry(_take)
reduce = curry(reduce)

go = lambda *args: reduce(lambda a,f: f(a), args) ## 함수도 축약 가능 ##
##############################################################################################################

# The inputs to this node will be stored as a list in the IN variables.
dataEnteringNode = IN

h_frameCrvsGrp = IN[0]
v_frameCrvsGrp = IN[1]
#v_frameCrvs = IN[1]
# Place your code below this line
def getSubList(iter, offset=2):
    res = []
    for i in range(0, len(iter) - (offset-1)):
        res.append([iter[i], iter[i+1]])
    return res

def getBothCrvPt(crv):
    return crv.StartPoint,crv.EndPoint


def getClosedCrv(h_CrvsGrp, v_CrvsGrp):
    res = []
    for hGrp in h_CrvsGrp:
        sorted_hGrp = sorted(hGrp, key=lambda x:x.StartPoint.Y)
        a = getSubList(sorted_hGrp,2)
        
        res.append(a)
    return res



    
#    tmp = go\
#    (
#        el,
#        lambda x: x.GetLocation(),
#        lambda x: x.Translate(0,0, el.GetParameterValueByName("Length")),
#    )

# Assign your output to the OUT variable.
OUT = getClosedCrv(h_frameCrvsGrp, v_frameCrvsGrp)

#OUT = getBothCrvPt(h_frameCrvsGrp[0][0])
# ----------------------------------------
code_block_6 = CodeBlock(i=getClosedCrv) { i[0][0]; }
code_block_7 = CodeBlock(i=groupByKey_4.groups) { i[0]; }
code_block_8 = CodeBlock(i=code_block_7) { i[0]; }
code_block_9 = CodeBlock(i=groupByKey_4.groups) { i[1]; }
code_block_10 = CodeBlock(i=code_block_9) { i[0]; }
join = List.Join(list0=code_block_6, list1=code_block_8, list2=code_block_10)
byJoinedCurves_3 = PolyCurve.ByJoinedCurves(curves=join)
patch = Curve.Patch(curve=byJoinedCurves_3)
code_block_11 = CodeBlock { 0.25; [0,1]; }
pointAtParameter = Surface.PointAtParameter(surface=patch, u=code_block_11.out0, v=code_block_11.out1)
firstItem_2 = List.FirstItem(list=pointAtParameter)
lastItem = List.LastItem(list=pointAtParameter)
byStartPointEndPoint = Line.ByStartPointEndPoint(startPoint=firstItem_2, endPoint=lastItem)
code_block_12 = CodeBlock { 0.75; }
pointAtParameter_2 = Surface.PointAtParameter(surface=patch, u=code_block_12, v=code_block_11.out1)
firstItem_3 = List.FirstItem(list=pointAtParameter_2)
lastItem_2 = List.LastItem(list=pointAtParameter_2)
byStartPointEndPoint_2 = Line.ByStartPointEndPoint(startPoint=firstItem_3, endPoint=lastItem_2)
reverse = List.Reverse(list=pointAtParameter_2)
join_2 = List.Join(list0=pointAtParameter, list1=reverse)
boolean = BoolSelector(true)
byPoints = PolyCurve.ByPoints(points=join_2, connectLastToFirst=boolean)
patch_2 = Curve.Patch(curve=byPoints)
difference = Surface.Difference(surface=patch, others=patch_2)
