# Dynamo graph 공통_Load Distribution_1.0.1.dyn (Dynamo 2.16.1.2727)

rooms_by_status = RoomsByStatus()
coreCenterBoundary = Room.CoreCenterBoundary(room=rooms_by_status.PlacedRooms)
byJoinedCurves = PolyCurve.ByJoinedCurves(curves=coreCenterBoundary)
categories = Categories("OST_StructuralFraming")
all_elements_of_category = ElementsOfCategory(Category=categories)
code_block = CodeBlock { "Reference Level"; }
getParameterValueByName = Element.GetParameterValueByName(element=all_elements_of_category, parameterName=code_block)
parameters = Element.Parameters(element=rooms_by_status.PlacedRooms)
explode = Geometry.Explode()  # unwired: geometry
categories_2 = Categories("OST_StructuralColumns")
all_elements_of_category_2 = ElementsOfCategory(Category=categories_2)
제외단면 = StringInput("""W200xL200,
W300xL300""")

# group: 제외 단면 명 리스트 정리구간
code_block_2 = CodeBlock { ","; }
split = String.Split(string=제외단면, separator0=code_block_2)
code_block_3 = CodeBlock { "\n"; }
split_2 = String.Split(string=split, separator0=code_block_3)
flatten = List.Flatten(list=split_2)

filterAGCols = Python(IN[0]=all_elements_of_category_2, IN[1]=flatten)  # CPython3
# ---------- filterAGCols.python (59 lines) ----------
# Load the Python Standard and DesignScript Libraries
import sys
import clr
clr.AddReference('ProtoGeometry')
from Autodesk.DesignScript.Geometry import *

#################################Module For Functional Programing#############################################
from functools import reduce
curry = lambda f: lambda a,*args: f(a, *args) if (len(args)) else lambda *args: f(a, *args)

filter = curry(filter)
map = curry(map)

def _take(length, iter):
    res = []
    for a in iter:
        res.append(a)
        if len(res) == length:
            return res
        
take = curry(_take)
reduce = curry(reduce)

go = lambda *args: reduce(lambda a,f: f(a), args) ## 함수도 축약 가능 ##
##############################################################################################################

# The inputs to this node will be stored as a list in the IN variables.
dataEnteringNode = IN
cols = IN[0]
exceptionRules = IN[1]
# Place your code below this line

#def getColumnCrv(els,exceptionRule):
#    res = go\
#    (
#        els,
#        filter(lambda x: "UG PED" not in str(x.GetParameterValueByName("Family and Type"))),
#        filter(lambda x: exceptionRule not in str(x.GetParameterValueByName("Family and Type"))),
#    )
#    
#    return res

def getColumnCrv_(els,exceptionRules):
    defaultFiltering = go\
    (
        els,
        filter(lambda x: "UG PED" not in str(x.GetParameterValueByName("Family and Type"))),
        list,
    )
    
    res = defaultFiltering
    for r in exceptionRules:
        res = list(filter(lambda x: r not in str(x.GetParameterValueByName("Family and Type")), res))
    
    
    return res

# Assign your output to the OUT variable.
OUT = getColumnCrv_(cols,exceptionRules)
# ----------------------------------------
getColumnCrv = Python(IN[0]=filterAGCols)  # CPython3
# ---------- getColumnCrv.python (43 lines) ----------
# Load the Python Standard and DesignScript Libraries
import sys
import clr
clr.AddReference('ProtoGeometry')
from Autodesk.DesignScript.Geometry import *

#################################Module For Functional Programing#############################################
from functools import reduce
curry = lambda f: lambda a,*args: f(a, *args) if (len(args)) else lambda *args: f(a, *args)

filter = curry(filter)
map = curry(map)

def _take(length, iter):
    res = []
    for a in iter:
        res.append(a)
        if len(res) == length:
            return res
        
take = curry(_take)
reduce = curry(reduce)

go = lambda *args: reduce(lambda a,f: f(a), args) ## 함수도 축약 가능 ##
##############################################################################################################

# The inputs to this node will be stored as a list in the IN variables.
dataEnteringNode = IN
cols = IN[0]
# Place your code below this line

def getColumnCrv(el):
    sttPt = el.GetLocation()
    endPt = go\
    (
        el,
        lambda x: x.GetLocation(),
        lambda x: x.Translate(0,0, el.GetParameterValueByName("Length")),
    )
    
    return Line.ByStartPointEndPoint(sttPt,endPt)
# Assign your output to the OUT variable.
OUT = map(getColumnCrv,cols)
# ----------------------------------------
select_model_element_by_category = DSModelElementByCategorySelection("OST_Roofs")  # 1 picked in the model
geometry = Element.Geometry(element=select_model_element_by_category)
getBottomCrv = Python(IN[0]=geometry)  # CPython3
# ---------- getBottomCrv.python (43 lines) ----------
# Load the Python Standard and DesignScript Libraries
import sys
import clr
clr.AddReference('ProtoGeometry')
from Autodesk.DesignScript.Geometry import *

#################################Module For Functional Programing#############################################
from functools import reduce
curry = lambda f: lambda a,*args: f(a, *args) if (len(args)) else lambda *args: f(a, *args)

filter = curry(filter)
map = curry(map)

def _take(length, iter):
    res = []
    for a in iter:
        res.append(a)
        if len(res) == length:
            return res
        
take = curry(_take)
reduce = curry(reduce)

go = lambda *args: reduce(lambda a,f: f(a), args) ## 함수도 축약 가능 ##
##############################################################################################################

# The inputs to this node will be stored as a list in the IN variables.
dataEnteringNode = IN
geo = IN[0][0]
# Place your code below this line

def getBtmCrvs(geo):
    btmSrf = go\
    (
        geo.Explode(),
        filter(lambda x:round(x.NormalAtParameter(0.5,0.5).Z, 4)==-1),
        list,
        lambda x: x[0].PerimeterCurves(),
    )
    
    return btmSrf
# Assign your output to the OUT variable.
OUT = getBtmCrvs(geo)
# ----------------------------------------
byJoinedCurves_2 = PolyCurve.ByJoinedCurves(curves=getBottomCrv)
byPatch = Surface.ByPatch(closedCurve=byJoinedCurves_2)
getLocation = Element.GetLocation(element=all_elements_of_category)
startPoint = Curve.StartPoint(curve=getLocation)
Z = Point.Z(point=startPoint)
code_block_4 = CodeBlock { 0; }
round = Math.Round(number=Z, digits=code_block_4)
groupByKey = List.GroupByKey(list=all_elements_of_category, keys=round)
code_block_5 = CodeBlock(i=groupByKey.groups) { i[1]; }
getLocation_2 = Element.GetLocation(element=code_block_5)
direction = Line.Direction(line=getLocation_2)
normalized = Vector.Normalized(vector=direction)
getXYZ = Python(IN[0]=normalized)  # CPython3
# ---------- getXYZ.python (42 lines) ----------
# Load the Python Standard and DesignScript Libraries
import sys
import clr
clr.AddReference('ProtoGeometry')
from Autodesk.DesignScript.Geometry import *

#################################Module For Functional Programing#############################################
from functools import reduce
curry = lambda f: lambda a,*args: f(a, *args) if (len(args)) else lambda *args: f(a, *args)

filter = curry(filter)
map = curry(map)

def _take(length, iter):
    res = []
    for a in iter:
        res.append(a)
        if len(res) == length:
            return res
        
take = curry(_take)
reduce = curry(reduce)

go = lambda *args: reduce(lambda a,f: f(a), args) ## 함수도 축약 가능 ##
##############################################################################################################

# The inputs to this node will be stored as a list in the IN variables.
dataEnteringNode = IN
vecs = IN[0]
# Place your code below this line

def getXYZ(vecs):
    res = go\
    (
        vecs,
        map(lambda x: (round(x.X), round(x.Y), round(x.Z))),
        map(str),
    )
    
    return res
# Assign your output to the OUT variable.
OUT = getXYZ(vecs)
# ----------------------------------------
firstItem = List.FirstItem(list=normalized)
isParallel = Vector.IsParallel(vector=firstItem, otherVector=normalized)
groupByKey_2 = List.GroupByKey(list=getLocation_2, keys=isParallel)
code_block_6 = CodeBlock(i=groupByKey_2.groups) { i[1]; }
length = Curve.Length(curve=code_block_6)
splitByPoints = Curve.SplitByPoints()  # unwired: curve, points
code_block_7 = CodeBlock(i=groupByKey_2.groups) { i[0]; }
code_block_8 = CodeBlock(i=code_block_7) { i[0]; i[1]; i[2]; }
startPoint_2 = Curve.StartPoint(curve=code_block_7)
X = Point.X(point=startPoint_2)
groupByKey_3 = List.GroupByKey(list=code_block_7, keys=X)
startPoint_3 = Curve.StartPoint(curve=groupByKey_3.groups)
Y = Point.Y(point=startPoint_3)
sortByKey = List.SortByKey(list=groupByKey_3.groups@L2, keys=Y@L2)
integer_slider = IntegerSlider(0, range=0..7 step 1)
code_block_9 = CodeBlock(i=sortByKey.sortedList, j=integer_slider) { i[j]; }
