# Dynamo graph 공통_Load Distribution_1.0.2.dyn (Dynamo 2.16.1.2727)

rooms_by_status = RoomsByStatus()
coreCenterBoundary = Room.CoreCenterBoundary(room=rooms_by_status.PlacedRooms)
byJoinedCurves = PolyCurve.ByJoinedCurves(curves=coreCenterBoundary)
categories = Categories("OST_StructuralFraming")
all_elements_of_category = ElementsOfCategory(Category=categories)
code_block = CodeBlock { "Reference Level"; }
getParameterValueByName = Element.GetParameterValueByName(element=all_elements_of_category, parameterName=code_block)
parameters = Element.Parameters(element=rooms_by_status.PlacedRooms)
explode = Geometry.Explode()  # unwired: geometry
categories_2 = Categories("OST_StructuralColumns")
all_elements_of_category_2 = ElementsOfCategory(Category=categories_2)
제외단면 = StringInput("""W200xL200,
W300xL300""")

# group: 제외 단면 명 리스트 정리구간
code_block_2 = CodeBlock { ","; }
split = String.Split(string=제외단면, separator0=code_block_2)
code_block_3 = CodeBlock { "\n"; }
split_2 = String.Split(string=split, separator0=code_block_3)
flatten = List.Flatten(list=split_2)

filterAGCols = Python(IN[0]=all_elements_of_category_2, IN[1]=flatten)  # CPython3
# ---------- filterAGCols.python (59 lines) ----------
# Load the Python Standard and DesignScript Libraries
import sys
import clr
clr.AddReference('ProtoGeometry')
from Autodesk.DesignScript.Geometry import *

#################################Module For Functional Programing#############################################
from functools import reduce
curry = lambda f: lambda a,*args: f(a, *args) if (len(args)) else lambda *args: f(a, *args)

filter = curry(filter)
map = curry(map)

def _take(length, iter):
    res = []
    for a in iter:
        res.append(a)
        if len(res) == length:
            return res
        
take = curry(_take)
reduce = curry(reduce)

go = lambda *args: reduce(lambda a,f: f(a), args) ## 함수도 축약 가능 ##
##############################################################################################################

# The inputs to this node will be stored as a list in the IN variables.
dataEnteringNode = IN
cols = IN[0]
exceptionRules = IN[1]
# Place your code below this line

#def getColumnCrv(els,exceptionRule):
#    res = go\
#    (
#        els,
#        filter(lambda x: "UG PED" not in str(x.GetParameterValueByName("Family and Type"))),
#        filter(lambda x: exceptionRule not in str(x.GetParameterValueByName("Family and Type"))),
#    )
#    
#    return res

def getColumnCrv_(els,exceptionRules):
    defaultFiltering = go\
    (
        els,
        filter(lambda x: "UG PED" not in str(x.GetParameterValueByName("Family and Type"))),
        list,
    )
    
    res = defaultFiltering
    for r in exceptionRules:
        res = list(filter(lambda x: r not in str(x.GetParameterValueByName("Family and Type")), res))
    
    
    return res

# Assign your output to the OUT variable.
OUT = getColumnCrv_(cols,exceptionRules)
# ----------------------------------------
getColumnCrv = Python(IN[0]=filterAGCols)  # CPython3
# ---------- getColumnCrv.python (43 lines) ----------
# Load the Python Standard and DesignScript Libraries
import sys
import clr
clr.AddReference('ProtoGeometry')
from Autodesk.DesignScript.Geometry import *

#################################Module For Functional Programing#############################################
from functools import reduce
curry = lambda f: lambda a,*args: f(a, *args) if (len(args)) else lambda *args: f(a, *args)

filter = curry(filter)
map = curry(map)

def _take(length, iter):
    res = []
    for a in iter:
        res.append(a)
        if len(res) == length:
            return res
        
take = curry(_take)
reduce = curry(reduce)

go = lambda *args: reduce(lambda a,f: f(a), args) ## 함수도 축약 가능 ##
##############################################################################################################

# The inputs to this node will be stored as a list in the IN variables.
dataEnteringNode = IN
cols = IN[0]
# Place your code below this line

def getColumnCrv(el):
    sttPt = el.GetLocation()
    endPt = go\
    (
        el,
        lambda x: x.GetLocation(),
        lambda x: x.Translate(0,0, el.GetParameterValueByName("Length")),
    )
    
    return Line.ByStartPointEndPoint(sttPt,endPt)
# Assign your output to the OUT variable.
OUT = map(getColumnCrv,cols)
# ----------------------------------------
select_model_element_by_category = DSModelElementByCategorySelection("OST_Roofs")  # 1 picked in the model
geometry = Element.Geometry(element=select_model_element_by_category)
getBottomCrv = Python(IN[0]=geometry)  # CPython3
# ---------- getBottomCrv.python (43 lines) ----------
# Load the Python Standard and DesignScript Libraries
import sys
import clr
clr.AddReference('ProtoGeometry')
from Autodesk.DesignScript.Geometry import *

#################################Module For Functional Programing#############################################
from functools import reduce
curry = lambda f: lambda a,*args: f(a, *args) if (len(args)) else lambda *args: f(a, *args)

filter = curry(filter)
map = curry(map)

def _take(length, iter):
    res = []
    for a in iter:
        res.append(a)
        if len(res) == length:
            return res
        
take = curry(_take)
reduce = curry(reduce)

go = lambda *args: reduce(lambda a,f: f(a), args) ## 함수도 축약 가능 ##
##############################################################################################################

# The inputs to this node will be stored as a list in the IN variables.
dataEnteringNode = IN
geo = IN[0][0]
# Place your code below this line

def getBtmCrvs(geo):
    btmSrf = go\
    (
        geo.Explode(),
        filter(lambda x:round(x.NormalAtParameter(0.5,0.5).Z, 4)==-1),
        list,
        lambda x: x[0].PerimeterCurves(),
    )
    
    return btmSrf
# Assign your output to the OUT variable.
OUT = getBtmCrvs(geo)
# ----------------------------------------
byJoinedCurves_2 = PolyCurve.ByJoinedCurves(curves=getBottomCrv)
byPatch = Surface.ByPatch(closedCurve=byJoinedCurves_2)
getLocation = Element.GetLocation(element=all_elements_of_category)
startPoint = Curve.StartPoint(curve=getLocation)
Z = Point.Z(point=startPoint)
code_block_4 = CodeBlock { 0; }
round = Math.Round(number=Z, digits=code_block_4)
groupByKey = List.GroupByKey(list=all_elements_of_category, keys=round)
code_block_5 = CodeBlock(i=groupByKey.groups) { i[1]; }

# group: 빔 위치 커브 X, Y 축 분개
getLocation_2 = Element.GetLocation(element=code_block_5)
direction = Line.Direction(line=getLocation_2)
normalized = Vector.Normalized(vector=direction)
getXYZ = Python(IN[0]=normalized)  # CPython3
# ---------- getXYZ.python (42 lines) ----------
# Load the Python Standard and DesignScript Libraries
import sys
import clr
clr.AddReference('ProtoGeometry')
from Autodesk.DesignScript.Geometry import *

#################################Module For Functional Programing#############################################
from functools import reduce
curry = lambda f: lambda a,*args: f(a, *args) if (len(args)) else lambda *args: f(a, *args)

filter = curry(filter)
map = curry(map)

def _take(length, iter):
    res = []
    for a in iter:
        res.append(a)
        if len(res) == length:
            return res
        
take = curry(_take)
reduce = curry(reduce)

go = lambda *args: reduce(lambda a,f: f(a), args) ## 함수도 축약 가능 ##
##############################################################################################################

# The inputs to this node will be stored as a list in the IN variables.
dataEnteringNode = IN
vecs = IN[0]
# Place your code below this line

def getXYZ(vecs):
    res = go\
    (
        vecs,
        map(lambda x: (round(x.X), round(x.Y), round(x.Z))),
        map(str),
    )
    
    return res
# Assign your output to the OUT variable.
OUT = getXYZ(vecs)
# ----------------------------------------
firstItem = List.FirstItem(list=normalized)
isParallel = Vector.IsParallel(vector=firstItem, otherVector=normalized)
groupByKey_2 = List.GroupByKey(list=getLocation_2, keys=isParallel)

code_block_6 = CodeBlock(i=groupByKey_2.groups) { i[0]; }
code_block_7 = CodeBlock(i=code_block_6) { i[0]; i[1]; i[2]; }
name = Element.Name(element=code_block_5)
code_block_8 = CodeBlock { "G"; }
contains = String.Contains(string=name, searchFor=code_block_8)
filterByBoolMask = List.FilterByBoolMask(list=code_block_5, mask=contains)
boolean = BoolSelector(true)
byPerimeterPoints = Surface.ByPerimeterPoints()  # unwired: points
startPoint_2 = Curve.StartPoint(curve=code_block_6)
X = Point.X(point=startPoint_2)
groupByKey_3 = List.GroupByKey(list=code_block_6, keys=X)
startPoint_3 = Curve.StartPoint(curve=groupByKey_3.groups)
Y = Point.Y(point=startPoint_3)
sortByKey = List.SortByKey(list=groupByKey_3.groups@L2, keys=Y@L2)
integer_slider = IntegerSlider(3, range=0..7 step 1)
code_block_9 = CodeBlock(i=sortByKey.sortedList, j=integer_slider) { i[j]; }
code_block_10 = CodeBlock(i=groupByKey_2.groups) { i[1]; }
startPoint_4 = Curve.StartPoint(curve=code_block_10)
Y_2 = Point.Y(point=startPoint_4)
string_from_object = FromObject(object=Y_2)
groupByKey_4 = List.GroupByKey(list=code_block_10, keys=string_from_object)
startPoint_5 = Curve.StartPoint(curve=groupByKey_4.groups)
X_2 = Point.X(point=startPoint_5)
sortByKey_2 = List.SortByKey(list=groupByKey_4.groups@L2, keys=X_2@L2)
integer_slider_2 = IntegerSlider(0, range=0..7 step 1)
code_block_11 = CodeBlock(i=sortByKey_2.sortedList, j=integer_slider_2) { i[j]; }
doesIntersect = Geometry.DoesIntersect(geometry=code_block_9, other=code_block_11, lacing=CrossProduct)
transpose = List.Transpose(lists=doesIntersect)
anyTrue = List.AnyTrue(list=transpose@L2)
filterByBoolMask_2 = List.FilterByBoolMask(list=code_block_11, mask=anyTrue)
code_block_12 = CodeBlock(i=filterByBoolMask_2.in) { i; }
intersect = Geometry.Intersect(geometry=code_block_9, other=code_block_12, lacing=CrossProduct)
flatten_2 = List.Flatten(list=intersect)
code_block_13 = CodeBlock { 100000; }
concave_Hull = Python(IN[0]=flatten_2, IN[1]=code_block_13)  # CPython3
# ---------- concave_Hull.python (61 lines) ----------
# Load the Python Standard and DesignScript Libraries
import sys
import clr
clr.AddReference('ProtoGeometry')
from Autodesk.DesignScript.Geometry import *
from Autodesk.DesignScript.Geometry import Line

from math import sqrt, hypot

# The inputs to this node will be stored as a list in the IN variables.
dataEnteringNode = IN
points = UnwrapElement(IN[0])
alpha = IN[1]
# Place your code below this line

def concave_hull(points, alpha):
    res = []
    
    pLen = len(points)
    alpha2 = alpha * alpha
    if pLen < 2:
        raise Exception('AlphaShape needs at least 2 points')

    for i, p in enumerate(points):
        for j in range(i+1, pLen):
            if p.IsAlmostEqualTo(points[j]):
                raise Exception('AlphaShape needs pairwise distinct points')
            dist = hypot(p.X - points[j].X, p.Y - points[j].Y)                    
            #if (dist > 2 * alpha) : continue #circle fits between points ==> p_i, p_j can't be alpha-exposed                    
    
            x1, y1, x2, y2 = p.X, p.Y, points[j].X, points[j].Y
            midX, midY = (x1 + x2) / 2, (y1 + y2) / 2
    
            #find two circles that contain p_i and p_j; note that center1 == center2 if dist == 2*alpha
            alphaDist = sqrt(alpha2 - (dist / 2) ** 2)
            #alphaDist = alpha2 - (dist / 2) ** 2
            deltaX, deltaY = (x2 - x1) / dist, (y1 - y2) / dist
            c1x, c1y = midX + alphaDist * deltaY, midY + alphaDist * deltaX
            c2x, c2y = midX - alphaDist * deltaY, midY - alphaDist * deltaX
            
            #check if one of the circles is alpha-exposed, i.e. no other point lies in it
            c1_empty = True 
            c2_empty = True
            for k in range(pLen):                
                if i == k or j == k: 
                    continue
                if ((c1x - points[k].X) * (c1x - points[k].X) + (c1y - points[k].Y) * (c1y - points[k].Y) < alpha2):
                    c1_empty = False
                if ((c2x - points[k].X) * (c2x - points[k].X) + (c2y - points[k].Y) * (c2y - points[k].Y) < alpha2):
                    c2_empty = False
                if not c1_empty and not c2_empty:
                    break
            if c1_empty or c2_empty:
                res.append(Line.ByStartPointEndPoint(p, points[j]))
                #res.append(c1_empty)
    return res



# Assign your output to the OUT variable.
OUT = concave_hull(points, alpha)
# ----------------------------------------
convex_Hull = Python()  # CPython3; frozen; unwired: IN[0], IN[1]
# ---------- convex_Hull.python (66 lines) ----------
# Load the Python Standard and DesignScript Libraries
import sys
import clr
clr.AddReference('ProtoGeometry')
from Autodesk.DesignScript.Geometry import *

from functools import reduce

# The inputs to this node will be stored as a list in the IN variables.
dataEnteringNode = IN
points, alpha = IN[0],IN[1]
# Place your code below this line

def ToVals(pt):
	return [pt.X,pt.Y,pt.Z]

def ToPts(ptVals):
	return Point.ByCoordinates(ptVals[0],ptVals[1],ptVals[2])

def CreateOutline(pts):
	crvs = []
	i = 0
	while i < len(pts):
		if i == len(pts)-1:
			crvs.append(Line.ByStartPointEndPoint(pts[i],pts[0]))
		else:
			crvs.append(Line.ByStartPointEndPoint(pts[i],pts[i+1]))
		i = i+1
	return PolyCurve.ByJoinedCurves(crvs)


'''
Taken from Thomas Switzers awesome GitHub repo and modified to suit Dynamo Context
https://gist.github.com/arthur-e/5cf52962341310f438e96c1f3c3398b8
I take zero credit for this work other than porting it across.
'''
def convex_hull_graham(points):
	'''
	Returns points on convex hull in CCW order according to Graham's scan algorithm. 
	By Tom Switzer <thomas.switzer@gmail.com>.
	'''
	TURN_LEFT, TURN_RIGHT, TURN_NONE = (1, -1, 0)

	def cmp(a, b):
		return (a > b) - (a < b)
	
	def turn(p, q, r):
		return cmp((q[0] - p[0])*(r[1] - p[1]) - (r[0] - p[0])*(q[1] - p[1]), 0)
	
	def _keep_left(hull, r):
		while len(hull) > 1 and turn(hull[-2], hull[-1], r) != TURN_LEFT:
			hull.pop()
		if not len(hull) or hull[-1] != r:
			hull.append(r)
		return hull

	points = [ToVals(p) for p in points]	
	points = sorted(points)
	l = reduce(_keep_left, points, [])
	u = reduce(_keep_left, reversed(points), [])
	points = l.extend(u[i] for i in range(1, len(u) - 1)) or l
	points = [ToPts(p) for p in points]
	return CreateOutline(points)

# Assign your output to the OUT variable.
OUT = convex_hull_graham(points)
# ----------------------------------------
frame_사이_일괄_면_생성 = Python(IN[1]=groupByKey_2.groups)  # CPython3; unwired: IN[0]
# ---------- frame_사이_일괄_면_생성.python (148 lines) ----------
# Load the Python Standard and DesignScript Libraries
import sys
import clr
clr.AddReference('ProtoGeometry')
from Autodesk.DesignScript.Geometry import *
from Autodesk.DesignScript.Geometry import Line

from math import sqrt, hypot
from itertools import combinations
################Module For Functional Programing#########################
from functools import reduce; from itertools import chain
from itertools import groupby; import operator
from copy import deepcopy
curry = lambda f: lambda a,*args: f(a, *args) if (len(args)) else lambda *args: f(a, *args)

filter, map, reduce = curry(filter), curry(map), curry(reduce)

go = lambda *args: reduce(lambda a,f: f(a), args) ## 함수도 축약 가능 ##

def dictUpdate(dic1,dic2):
    dic1.update(dic2)
    return dic1
    
def dictsMerge(dics):
    res = reduce(dictUpdate, dics)
    return res
    
def dictDeleteKeys(dic, keys):
    for k in keys:
        del dic[k]
    return dic

def flat(a):
    if isinstance(a, list):
        for i in a: 
            yield from flat(i)
    else: yield a

def grpBy(iter, key):
    f,keys,grps = key,[],[]
    sorted_ = sorted(iter, key=f)
    for key, grp_data in groupby(sorted_,key=f):
        keys.append(key); grps.append(list(grp_data))
    return grps,keys
#########################################################################

def concave_hull_(points, alpha):
    points = UnwrapElement(points)
    res = []
    
    pLen = len(points)
    alpha2 = alpha * alpha
    if pLen < 2:
        raise Exception('AlphaShape needs at least 2 points')

    for i, p in enumerate(points):
        for j in range(i+1, pLen):
            if p.IsAlmostEqualTo(points[j]):
                raise Exception('AlphaShape needs pairwise distinct points')
            dist = hypot(p.X - points[j].X, p.Y - points[j].Y)                    
            #if (dist > 2 * alpha) : continue #circle fits between points ==> p_i, p_j can't be alpha-exposed                    
    
            x1, y1, x2, y2 = p.X, p.Y, points[j].X, points[j].Y
            midX, midY = (x1 + x2) / 2, (y1 + y2) / 2
    
            #find two circles that contain p_i and p_j; note that center1 == center2 if dist == 2*alpha
            alphaDist = sqrt(alpha2 - (dist / 2) ** 2)
            #alphaDist = alpha2 - (dist / 2) ** 2
            deltaX, deltaY = (x2 - x1) / dist, (y1 - y2) / dist
            c1x, c1y = midX + alphaDist * deltaY, midY + alphaDist * deltaX
            c2x, c2y = midX - alphaDist * deltaY, midY - alphaDist * deltaX
            
            #check if one of the circles is alpha-exposed, i.e. no other point lies in it
            c1_empty = True 
            c2_empty = True
            for k in range(pLen):                
                if i == k or j == k: 
                    continue
                if ((c1x - points[k].X) * (c1x - points[k].X) + (c1y - points[k].Y) * (c1y - points[k].Y) < alpha2):
                    c1_empty = False
                if ((c2x - points[k].X) * (c2x - points[k].X) + (c2y - points[k].Y) * (c2y - points[k].Y) < alpha2):
                    c2_empty = False
                if not c1_empty and not c2_empty:
                    break
            if c1_empty or c2_empty:
                res.append(Line.ByStartPointEndPoint(p, points[j]))
                #res.append(c1_empty)
    return res
    
# The inputs to this node will be stored as a list in the IN variables.
dataEnteringNode = IN
#concaveHullfunc = IN[0]
grids = IN[1]
gridsX, gridsY = grids

# Place your code below this line


dataX = go(
    gridsX,
    lambda x: sorted(x, key=lambda e: e.StartPoint.X),
    lambda x: grpBy(x, key=lambda e: e.StartPoint.X)[0],
    map(lambda x: sorted(x, key=lambda e: e.StartPoint.Y)),
    #2개씩 1간격으로 서브리스트 생성
    map(lambda x: list(map(lambda n: x[n:n+1+1], range(len(x))[:-1]))),
    list,
)
dataY = go(
    gridsY,
    lambda x: sorted(x, key=lambda e: e.StartPoint.X),
    lambda x: grpBy(x, key=lambda e: e.StartPoint.X)[0],
    map(lambda x: sorted(x, key=lambda e: e.StartPoint.Y)),list,
    #2개씩 1간격으로 서브리스트 생성
    lambda x: list(map(lambda n: x[n:n+1+1], range(len(x))[:-1])),
    # 서브리스트 구조 Transpose
    map(lambda x: list(zip(*chain(x)))),
    list,
)

res = []
for i,j in list(zip(dataX,dataY)):
    for eX in i:
        for eY in j:
            combinedSet = list(eX)+list(eY)
            allIntsctPts = []
            tmp = combinations(combinedSet, 2)
            for f,n in tmp:
                allIntsctPts.append(f.Intersect(n))
            allIntsctPts = list(chain(*allIntsctPts))
            try:
                crvSet = concave_hull_(allIntsctPts, 100000)
                polyCrv = PolyCurve.ByJoinedCurves(crvSet)
                srf = Surface.ByPatch(polyCrv)
                srfThick = srf.Thicken(10,False)
                bdCube = BoundingBox.ByGeometry(srfThick).ToCuboid()
                bdCubeSrfs = bdCube.Explode()
                bdBelowSrf = go(
                    bdCubeSrfs,
                    filter(lambda x: x.NormalAtParameter(0.5,0.5).Z == -1),
                    list
                )[0]
                res.append(bdBelowSrf)
            except:
                pass
                #res.append("")
    
# Assign your output to the OUT variable.
OUT = res
# ----------------------------------------
frame_사이_일괄_면_생성_new = Python(IN[1]=groupByKey_2.groups)  # CPython3; unwired: IN[0]
# ---------- frame_사이_일괄_면_생성_new.python (149 lines) ----------
# Load the Python Standard and DesignScript Libraries
import sys
import clr
clr.AddReference('ProtoGeometry')
from Autodesk.DesignScript.Geometry import *
from Autodesk.DesignScript.Geometry import Line

from math import sqrt, hypot
from itertools import combinations
################Module For Functional Programing#########################
from functools import reduce; from itertools import chain
from itertools import groupby; import operator
from copy import deepcopy
curry = lambda f: lambda a,*args: f(a, *args) if (len(args)) else lambda *args: f(a, *args)

filter, map, reduce = curry(filter), curry(map), curry(reduce)

go = lambda *args: reduce(lambda a,f: f(a), args) ## 함수도 축약 가능 ##

def dictUpdate(dic1,dic2):
    dic1.update(dic2)
    return dic1
    
def dictsMerge(dics):
    res = reduce(dictUpdate, dics)
    return res
    
def dictDeleteKeys(dic, keys):
    for k in keys:
        del dic[k]
    return dic

def flat(a):
    if isinstance(a, list):
        for i in a: 
            yield from flat(i)
    else: yield a

def grpBy(iter, key):
    f,keys,grps = key,[],[]
    sorted_ = sorted(iter, key=f)
    for key, grp_data in groupby(sorted_,key=f):
        keys.append(key); grps.append(list(grp_data))
    return grps,keys
#########################################################################

def concave_hull_(points, alpha):
    points = UnwrapElement(points)
    res = []
    
    pLen = len(points)
    alpha2 = alpha * alpha
    if pLen < 2:
        raise Exception('AlphaShape needs at least 2 points')

    for i, p in enumerate(points):
        for j in range(i+1, pLen):
            if p.IsAlmostEqualTo(points[j]):
                raise Exception('AlphaShape needs pairwise distinct points')
            dist = hypot(p.X - points[j].X, p.Y - points[j].Y)                    
            #if (dist > 2 * alpha) : continue #circle fits between points ==> p_i, p_j can't be alpha-exposed                    
    
            x1, y1, x2, y2 = p.X, p.Y, points[j].X, points[j].Y
            midX, midY = (x1 + x2) / 2, (y1 + y2) / 2
    
            #find two circles that contain p_i and p_j; note that center1 == center2 if dist == 2*alpha
            alphaDist = sqrt(alpha2 - (dist / 2) ** 2)
            #alphaDist = alpha2 - (dist / 2) ** 2
            deltaX, deltaY = (x2 - x1) / dist, (y1 - y2) / dist
            c1x, c1y = midX + alphaDist * deltaY, midY + alphaDist * deltaX
            c2x, c2y = midX - alphaDist * deltaY, midY - alphaDist * deltaX
            
            #check if one of the circles is alpha-exposed, i.e. no other point lies in it
            c1_empty = True 
            c2_empty = True
            for k in range(pLen):                
                if i == k or j == k: 
                    continue
                if ((c1x - points[k].X) * (c1x - points[k].X) + (c1y - points[k].Y) * (c1y - points[k].Y) < alpha2):
                    c1_empty = False
                if ((c2x - points[k].X) * (c2x - points[k].X) + (c2y - points[k].Y) * (c2y - points[k].Y) < alpha2):
                    c2_empty = False
                if not c1_empty and not c2_empty:
                    break
            if c1_empty or c2_empty:
                res.append(Line.ByStartPointEndPoint(p, points[j]))
                #res.append(c1_empty)
    return res
    
# The inputs to this node will be stored as a list in the IN variables.
dataEnteringNode = IN
#concaveHullfunc = IN[0]
grids = IN[1]
gridsX, gridsY = grids

# Place your code below this line


dataX = go(
    gridsX,
    lambda x: sorted(x, key=lambda e: e.StartPoint.X),
    lambda x: grpBy(x, key=lambda e: e.StartPoint.X)[0],
    map(lambda x: sorted(x, key=lambda e: e.StartPoint.Y)),
    #2개씩 1간격으로 서브리스트 생성
    map(lambda x: list(map(lambda n: x[n:n+1+1], range(len(x))[:-1]))),
    lambda x: list(chain(*x)),
)
dataY = go(
    gridsY,
    lambda x: sorted(x, key=lambda e: e.StartPoint.X),
    lambda x: grpBy(x, key=lambda e: e.StartPoint.X)[0],
    map(lambda x: sorted(x, key=lambda e: e.StartPoint.Y)),list,
    #2개씩 1간격으로 서브리스트 생성
    lambda x: list(map(lambda n: x[n:n+1+1], range(len(x))[:-1])),
    # 서브리스트 구조 Transpose
    map(lambda x: list(zip(*chain(x)))),
    lambda x: list(chain(*x)),
)

def get_IntersectInGrp(xGrp, yGrp):
    res = []
    for x in xGrp:
        for y in yGrp:
            res.append(x.Intersect(y))
    return list(chain(*res))

def main(xGrps, yGrps):
    res = []
    for xGrp in xGrps:
        for yGrp in yGrps:
            intscts = get_IntersectInGrp(xGrp, yGrp)
            try:
                crvSet = concave_hull_(intscts, 100000)
                polyCrv = PolyCurve.ByJoinedCurves(crvSet)
                srf = Surface.ByPatch(polyCrv)
                srfThick = srf.Thicken(10,False)
                bdCube = BoundingBox.ByGeometry(srfThick).ToCuboid()
                bdCubeSrfs = bdCube.Explode()
                bdBelowSrf = go(
                    bdCubeSrfs,
                    filter(lambda x: x.NormalAtParameter(0.5,0.5).Z == -1),
                    list
                )[0]
                res.append(bdBelowSrf)
            except: pass
    return res
    
# Assign your output to the OUT variable.
OUT = main(dataX, dataY)
# ----------------------------------------
integer_slider_3 = IntegerSlider(16, range=0..16 step 1)
code_block_14 = CodeBlock(i=frame_사이_일괄_면_생성_new, j=integer_slider_3) { i[j]; }
color_palette = ColorPalette({R: 255, G: 105, B: 180, A: 255})
byGeometryColor = Modifiers.GeometryColor.ByGeometryColor(geometry=code_block_14, color=color_palette)
color_palette_2 = ColorPalette({R: 170, G: 193, B: 233, A: 154})
byGeometryColor_2 = Modifiers.GeometryColor.ByGeometryColor(geometry=frame_사이_일괄_면_생성_new, color=color_palette_2)
code_block_15 = CodeBlock(i=frame_사이_일괄_면_생성_new) { i[0][1]; }
code_block_16 = CodeBlock(i=frame_사이_일괄_면_생성_new) { i[0][1][0]; }
