# Dynamo graph 공통_마감 Floor 메이커_1.0.0.dyn (Dynamo 2.16.1.2727)
# author: MK Jang
# Summary of Revit File

# group: get Room Datas
rooms_by_status = RoomsByStatus()
code_block = CodeBlock(i=rooms_by_status.PlacedRooms) { i; }
parameters = Element.Parameters(element=code_block)
code_block_2 = CodeBlock()
# ---------- code_block_2.designscript (10 lines) ----------
[
"Name",
"Number",
"Level",
"Area",
"H_Floor Finish Style Name",
"H_Skirt Finish Style Name",
"H_Wall Finish Style Name",
"H_Ceiling Finish Style Name"
];
# ----------------------------------------
parameterByName = Parameter.ParameterByName(element=code_block@L1, name=code_block_2)
code_block_3 = CodeBlock { 1; }
getItemAtIndex = List.GetItemAtIndex(list=parameterByName@@L2, index=code_block_3)
value = Parameter.Value(parameter=getItemAtIndex)
sortByKey = List.SortByKey(list=parameterByName, keys=value)
name = Parameter.Name(parameter=sortByKey.sortedList)
value_2 = Parameter.Value(parameter=sortByKey.sortedList)
set_room_datas = Python(IN[0]=sortByKey.sortedList)  # CPython3
# ---------- set_room_datas.python (51 lines) ----------
# Load the Python Standard and DesignScript Libraries
import sys
import clr
clr.AddReference('ProtoGeometry')
from Autodesk.DesignScript.Geometry import *

#################################Module For Functional Programing#############################################
from functools import reduce
curry = lambda f: lambda a,*args: f(a, *args) if (len(args)) else lambda *args: f(a, *args)

filter = curry(filter)
map = curry(map)

def _take(length, iter):
    res = []
    for a in iter:
        res.append(a)
        if len(res) == length:
            return res
        
take = curry(_take)
reduce = curry(reduce)

go = lambda *args: reduce(lambda a,f: f(a), args) ## 함수도 축약 가능 ##
##############################################################################################################

# The inputs to this node will be stored as a list in the IN variables.
dataEnteringNode = IN
roomDatas = IN[0]

# Place your code below this line

def setRoomDataPair(roomData):
    keys = list(map(lambda x: x.Name, roomData))
    vals_src = list(map(lambda x: x.Value, roomData))
    preVals = \
    go(
        vals_src[:4],
        lambda x: [x[0], x[1], x[2], round(x[3],2)]
    )
    
    postVals = [x if isinstance(x,str) or x==None
                else x.GetParameterValueByName("Key Name")
                for x in vals_src[4:]]

    vals = preVals + postVals
    
    return keys, vals
#keys = list(map(lambda x: x.Name, roomDatas[0]))
# Assign your output to the OUT variable.
OUT = map(setRoomDataPair, roomDatas)
# ----------------------------------------
code_block_4 = CodeBlock()
# ---------- code_block_4.designscript (10 lines) ----------
[
"Name",
"Number",
"Level",
"Area",
"Floor Finish Style No",
"Skirt Finish Style No",
"Wall Finish Style No",
"Ceiling Finish Style No"
];
# ----------------------------------------

# group: All Elements in Revit
all_elementsexceptrails = Python()  # CPython3; unwired: IN[0]
# ---------- all_elementsexceptrails.python (51 lines) ----------
# Load the Python Standard and DesignScript Libraries
import sys
import clr
clr.AddReference('ProtoGeometry')
from Autodesk.DesignScript.Geometry import *

clr.AddReference('RevitAPI')
from Autodesk.Revit.DB import *
import Autodesk

clr.AddReference('RevitServices')
import RevitServices
from RevitServices.Persistence import DocumentManager
doc = DocumentManager.Instance.CurrentDBDocument

def get_all_BIC():

    db = [
    Autodesk.Revit.DB.BuiltInCategory.OST_Floors,
    Autodesk.Revit.DB.BuiltInCategory.OST_Roofs,
    Autodesk.Revit.DB.BuiltInCategory.OST_Walls,
    Autodesk.Revit.DB.BuiltInCategory.OST_StructuralFoundation,
    Autodesk.Revit.DB.BuiltInCategory.OST_StructuralColumns,
    Autodesk.Revit.DB.BuiltInCategory.OST_StructuralFraming,
    Autodesk.Revit.DB.BuiltInCategory.OST_Ceilings,
    Autodesk.Revit.DB.BuiltInCategory.OST_Doors,
    Autodesk.Revit.DB.BuiltInCategory.OST_Windows,
    #Autodesk.Revit.DB.BuiltInCategory.OST_Stairs,
    #Autodesk.Revit.DB.BuiltInCategory.OST_Railings,
    ]
    return db
    
def get_allElems(doc):
    bics = get_all_BIC()
    
    def getElems(x):
        collector = FilteredElementCollector(doc)
        res = collector.OfCategory(x).WhereElementIsNotElementType().ToElements()
        return res

    def getRailElems(x):
        collector = FilteredElementCollector(doc)
        res = collector.OfCategory(x).WhereElementIsNotElementType()
        return res

    res = map(getElems, bics)
#    res = getRailElems(Autodesk.Revit.DB.BuiltInCategory.OST_RailingSystemRail)
    return res


OUT = get_allElems(doc)
# ----------------------------------------
categories = Categories("OST_Stairs")
all_elements_of_category = ElementsOfCategory(Category=categories)
list_create = List.Create(item0=all_elements_of_category)
categories_2 = Categories("OST_StairsRailing")
all_elements_of_category_2 = ElementsOfCategory(Category=categories_2)
list_create_2 = List.Create(item0=all_elements_of_category_2)
categories_3 = Categories("OST_GenericModel")
all_elements_of_category_3 = ElementsOfCategory(Category=categories_3)
list_create_3 = List.Create(item0=all_elements_of_category_3)
join = List.Join(list0=all_elementsexceptrails, list1=list_create, list2=list_create_2, list3=list_create_3)

exportAsImage = View.ExportAsImage()  # unwired: view, path
create_html_file_and_open = Python()  # CPython3; frozen; unwired: IN[0], IN[1], IN[2]
# ---------- create_html_file_and_open.python (85 lines) ----------
# Load the Python Standard and DesignScript Libraries
import os
import sys
import clr
clr.AddReference('ProtoGeometry')
from Autodesk.DesignScript.Geometry import *

clr.AddReference('RevitNodes')
import Revit
clr.ImportExtensions(Revit.Elements)
from Revit import Elements

import time
import subprocess
import asyncio
import multiprocessing

#################################Module For Functional Programing#############################################
from functools import reduce
curry = lambda f: lambda a,*args: f(a, *args) if (len(args)) else lambda *args: f(a, *args)

filter = curry(filter)
map = curry(map)

def _take(length, iter):
    res = []
    for a in iter:
        res.append(a)
        if len(res) == length:
            return res
        
take = curry(_take)
reduce = curry(reduce)

go = lambda *args: reduce(lambda a,f: f(a), args) ## 함수도 축약 가능 ##
##############################################################################################################

# The inputs to this node will be stored as a list in the IN variables.
dataEnteringNode = IN
contents = IN[0]
folderPath = IN[1]
cwd = folderPath
portNo = IN[2]
#bdName = IN[2]
# Place your code below this line

def find_cwd():
    doc = Revit.Application.Document.Current
    filePath_string = doc.FilePath
    folderPath = filePath_string.split('\\')
    folderPath.pop(-1)
    folderPath_str = '\\'.join(folderPath)
    return folderPath_str

def make_resultHTMLname(htmlStr,title,cwd):
    timeStamp = time.strftime('%H_%M_%S', time.localtime(time.time()))
    #folderPath = f"{cwd}\\.dynLog"
    folderPath = cwd
    if not os.path.exists(folderPath):
        os.makedirs(folderPath)
    fileName = f"index.html"
    filePath = f"{folderPath}\\" + fileName
    f = open(filePath, 'w', encoding='utf8')
    f.write(htmlStr)
    f.close()
    return fileName


def execute_browser(cwd):
    #cwd = find_cwd()
    folderPath = cwd
    os.chdir(folderPath)
    #cmdStr = "start chrome http:localhost:8000"
    cmdStr = f"start msedge http:localhost:{portNo}"
    cmdList= cmdStr.split(' ')
    #subprocess.run(args=[fileName], shell=True)
    #subprocess.run(args=['start','excel',fileName], shell=True)
    subprocess.run(args=cmdList, shell=True)
    return cmdList


fileName = make_resultHTMLname(contents,"test",cwd)

# Assign your output to the OUT variable.
OUT = execute_browser(cwd)#fileName.split('.')[0]
# ----------------------------------------
coreCenterBoundary = Room.CoreCenterBoundary()  # unwired: room
n1_마감_바닥을_작성할_룸_객체를_선택해_주세요 = DSModelElementByCategorySelection("OST_Rooms")  # "1. 마감 바닥을 작성할 룸 객체를 선택해 주세요"; 1 picked in the model; graph input
finishBoundary = Room.FinishBoundary(room=n1_마감_바닥을_작성할_룸_객체를_선택해_주세요)
n2_작성할_마감_바닥의_패밀리타입을명_입력해주세요 = StringInput("H_FL_AR_B10_Raised Floor_600x600xH700")  # "2. 작성할 마감 바닥의 패밀리타입을명 입력해주세요"; graph input
byName = FloorType.ByName(name=n2_작성할_마감_바닥의_패밀리타입을명_입력해주세요)
n3_마감_바닥이_배치될_레벨을_지정해주세요 = Levels("TOF")  # "3. 마감 바닥이 배치될 레벨을 지정해주세요"; graph input
byOutlineTypeAndLevel = Floor.ByOutlineTypeAndLevel(outlineCurves=finishBoundary, floorType=byName, level=n3_마감_바닥이_배치될_레벨을_지정해주세요)
code_block_5 = CodeBlock { "Height Offset From Level"; }
n4_기준레벨로_부터_띄울_높이를_입력해주세요_mm = DoubleInput(700)  # "4. 기준레벨로 부터 띄울 높이를 입력해주세요(mm)"; graph input
setParameterByName = Element.SetParameterByName(element=byOutlineTypeAndLevel, parameterName=code_block_5, value=n4_기준레벨로_부터_띄울_높이를_입력해주세요_mm)
watch = Watch(setParameterByName)  # graph output
parameters_2 = Element.Parameters(element=n1_마감_바닥을_작성할_룸_객체를_선택해_주세요)
