# Dynamo graph 내벽높이자동조정.dyn (Dynamo 3.3.0.6316)

룸별_실링_바운더리_라인_생성 = Python()  # CPython3; unwired: IN[0]
# ---------- 룸별_실링_바운더리_라인_생성.python (52 lines) ----------
# IN: (없음, 혹은 필요에 따라 CeilingType 등 다른 입력을 무시)
import clr
clr.AddReference('RevitAPI')
clr.AddReference('RevitServices')

from Autodesk.Revit.DB import (
    FilteredElementCollector,
    BuiltInCategory,
    SpatialElementBoundaryOptions,
    CurveLoop
)
from RevitServices.Persistence import DocumentManager

# 문서 가져오기
doc = DocumentManager.Instance.CurrentDBDocument

# 1) 모든 Room 수집
rooms = FilteredElementCollector(doc)\
    .OfCategory(BuiltInCategory.OST_Rooms)\
    .WhereElementIsNotElementType()\
    .ToElements()

boundaryLoops = []

for room in rooms:
    # 2) H_Room H or CH 파라미터에 값 있는 방만
    p = room.LookupParameter("H_Room H or CH")
    if not p:
        continue
    # 값이 없거나 0이면 건너뛰기
    try:
        if p.AsDouble() == 0.0:
            continue
    except:
        if not p.AsString():
            continue

    # 3) 경계 세그먼트 가져오기
    opts = SpatialElementBoundaryOptions()
    segments = room.GetBoundarySegments(opts)
    if not segments:
        continue

    # 4) 각 세그리스트를 CurveLoop으로 변환
    for segList in segments:
        loop = CurveLoop()
        for seg in segList:
            loop.Append(seg.GetCurve())
        boundaryLoops.append(loop)

# 5) 결과 출력: CurveLoop 객체 리스트
OUT = boundaryLoops
# ----------------------------------------
룸별_실링_바운더리_라인_생성2 = Python()  # CPython3; unwired: IN[0]
# ---------- 룸별_실링_바운더리_라인_생성2.python (68 lines) ----------
# IN: (없음)
import clr
# Revit API
clr.AddReference('RevitAPI')
clr.AddReference('RevitServices')
from Autodesk.Revit.DB import (
    FilteredElementCollector,
    BuiltInCategory,
    SpatialElementBoundaryOptions,
    CurveLoop,
    UnitUtils,
    UnitTypeId
)
from RevitServices.Persistence import DocumentManager

doc = DocumentManager.Instance.CurrentDBDocument

# 1) 모든 Room 수집
rooms = FilteredElementCollector(doc)\
    .OfCategory(BuiltInCategory.OST_Rooms)\
    .WhereElementIsNotElementType()\
    .ToElements()

# 2) 결과 저장할 리스트: [[CurveLoop, height_mm, Level], ...]
boundaryWithInfo = []

for room in rooms:
    # 파라미터 읽기
    p = room.LookupParameter("H_Room H or CH")
    roomNo = room.LookupParameter("Number").AsString()
    roomName = room.LookupParameter("Name").AsString()
    roomNoName = f"{roomNo}_{roomName}"
    if not p:
        continue

    # 값이 없거나 0이면 스킵
    try:
        val_ft = p.AsDouble()
        if val_ft == 0.0:
            continue
        height_mm = UnitUtils.ConvertFromInternalUnits(val_ft, UnitTypeId.Millimeters)
    except:
        s = p.AsString()
        if not s:
            continue
        try:
            height_mm = float(s)
        except:
            continue

    # 해당 방의 Level 객체
    level = doc.GetElement(room.LevelId)

    # 경계 세그먼트 가져오기
    opts = SpatialElementBoundaryOptions()
    segments = room.GetBoundarySegments(opts)
    if not segments:
        continue

    # 각 루프별로 정보 저장
    for segList in segments:
        loop = CurveLoop()
        for seg in segList:
            loop.Append(seg.GetCurve())
        boundaryWithInfo.append([loop, height_mm, roomNoName, level])

# OUT: [[CurveLoop, height_mm, Level], …]
OUT = boundaryWithInfo
# ----------------------------------------
ceiling_types = CeilingTypes("H_CE_AR_B09_Acoustic Ceiling_T Bar_600x600x9T")
룸별_실링_바운더리_라인_생성3 = Python()  # CPython3; unwired: IN[0]
# ---------- 룸별_실링_바운더리_라인_생성3.python (77 lines) ----------
# IN: (없음)
import clr
# Revit API
clr.AddReference('RevitAPI')
clr.AddReference('RevitServices')
from Autodesk.Revit.DB import (
    FilteredElementCollector,
    BuiltInCategory,
    SpatialElementBoundaryOptions,
    SpatialElementBoundaryLocation,
    CurveLoop,
    UnitUtils,
    UnitTypeId
)
from RevitServices.Persistence import DocumentManager

doc = DocumentManager.Instance.CurrentDBDocument


# 1) Prepare your boundary options to use the wall centerline:
opts = SpatialElementBoundaryOptions()
#opts.SpatialElementBoundaryLocation = SpatialElementBoundaryLocation.Center      # centerline of wall thickness :contentReference[oaicite:0]{index=0}
# or, if you want the core‑centre (i.e. mid‑thickness of the wall’s core structure), use:
opts.SpatialElementBoundaryLocation = SpatialElementBoundaryLocation.CoreCenter #:contentReference[oaicite:1]{index=1}


# 1) 모든 Room 수집
rooms = FilteredElementCollector(doc)\
    .OfCategory(BuiltInCategory.OST_Rooms)\
    .WhereElementIsNotElementType()\
    .ToElements()

# 2) 결과 저장할 리스트: [[CurveLoop, height_mm, Level], ...]
boundaryWithInfo = []

for room in rooms:
    # 파라미터 읽기
    p = room.LookupParameter("H_Room H or CH")
    roomNo = room.LookupParameter("Number").AsString()
    roomName = room.LookupParameter("Name").AsString()
    roomNoName = f"{roomNo}_{roomName}"
    if not p:
        continue

    # 값이 없거나 0이면 스킵
    try:
        val_ft = p.AsDouble()
        if val_ft == 0.0:
            continue
        height_mm = UnitUtils.ConvertFromInternalUnits(val_ft, UnitTypeId.Millimeters)
    except:
        s = p.AsString()
        if not s:
            continue
        try:
            height_mm = float(s)
        except:
            continue

    # 해당 방의 Level 객체
    level = doc.GetElement(room.LevelId)

    # 경계 세그먼트 가져오기
    opts = SpatialElementBoundaryOptions()
    segments = room.GetBoundarySegments(opts)
    if not segments:
        continue

    # 각 루프별로 정보 저장
    for segList in segments:
        loop = CurveLoop()
        for seg in segList:
            loop.Append(seg.GetCurve())
        boundaryWithInfo.append([loop, height_mm, roomNoName, level])

# OUT: [[CurveLoop, height_mm, Level], …]
OUT = boundaryWithInfo
# ----------------------------------------
code_block = CodeBlock(slot=룸별_실링_바운더리_라인_생성3) { slot; }
firstItem = List.FirstItem(list=code_block@L3)
라인_시각화 = Python(IN[0]=firstItem)  # CPython3
# ---------- 라인_시각화.python (25 lines) ----------
# IN[0] : List of Autodesk.Revit.DB.CurveLoop (from your boundary‐extraction script)

import clr
# DesignScript Geometry
clr.AddReference('ProtoGeometry')
from Autodesk.DesignScript.Geometry import PolyCurve
# Revit⇄Dynamo 변환 확장 메서드
clr.AddReference('RevitNodes')
import Revit
clr.ImportExtensions(Revit.GeometryConversion)  # ToProtoType() 지원 :contentReference[oaicite:0]{index=0}

# 실제 변환 처리
dynamoLoops = []
for loop in IN[0]:
    # loop: Autodesk.Revit.DB.CurveLoop → 각 Revit Curve
    dsCurves = []
    for rvtCurve in loop:
        # Revit Curve → Dynamo Curve (DesignScript)  
        dsCurves.append(rvtCurve.ToProtoType())  # ToProtoType() 사용 :contentReference[oaicite:1]{index=1}
    # 여러 Curve를 하나의 PolyCurve(Joined Curves)로 묶기
    poly = PolyCurve.ByJoinedCurves(dsCurves)
    dynamoLoops.append(poly)

# 결과 출력: Dynamo PolyCurve 리스트
OUT = dynamoLoops
# ----------------------------------------
code_block_2 = CodeBlock { 2; }
getItemAtIndex = List.GetItemAtIndex(list=code_block@L3, index=code_block_2)
lastItem = List.LastItem(list=code_block@L3)
code_block_3 = CodeBlock { 1; }
getItemAtIndex_2 = List.GetItemAtIndex(list=code_block@L3, index=code_block_3)
실링_생성 = Python(IN[0]=ceiling_types, IN[1]=라인_시각화, IN[2]=getItemAtIndex, IN[3]=lastItem, IN[4]=getItemAtIndex_2)  # CPython3
# ---------- 실링_생성.python (79 lines) ----------
# Dynamo Python Script for Ceiling Creation with Room Names and Error Logging
# IN[0] : CeilingType (Revit.Elements.CeilingType)
# IN[1] : List of curve lists            (List of Autodesk.DesignScript.Geometry.Curve[])
# IN[2] : List of room name strings      (List of str)
# IN[3] : List of Level objects          (List of Revit.Elements.Level)
# IN[4] : List of heights in mm (double) (List of float)

import clr

# --- Dynamo & Revit.Elements references ---
clr.AddReference('RevitNodes')
import Revit
clr.ImportExtensions(Revit.Elements)    # ZeroTouch nodes support

# --- Revit API for parameter setting ---
clr.AddReference('RevitAPI')
from Autodesk.Revit.DB import UnitUtils, UnitTypeId

# --- RevitServices for document & transactions ---
clr.AddReference('RevitServices')
from RevitServices.Persistence import DocumentManager
from RevitServices.Transactions import TransactionManager

doc = DocumentManager.Instance.CurrentDBDocument

# Inputs
ceiling_type = IN[0]
curve_lists  = IN[1]
room_names   = IN[2]
levels       = IN[3]
heights_mm   = IN[4]

# Outputs
created_ceilings = []
error_logs       = []

# Correct input order: curves, roomName, lvl, h_mm
for curves, room_name, lvl, h_mm in zip(curve_lists, room_names, levels, heights_mm):
    # 1) Create ceiling via ZeroTouch node
    try:
        ceiling_wrapper = Revit.Elements.Ceiling.ByOutlineTypeAndLevel(curves, ceiling_type, lvl)
    except Exception as ex:
        error_logs.append(f"Room '{room_name}': Ceiling creation failed: {ex}")
        continue

    # 2) Get native Revit element
    revit_ceiling = ceiling_wrapper.InternalElement

    # 3) Convert height to internal units
    try:
        h_internal = UnitUtils.ConvertToInternalUnits(h_mm, UnitTypeId.Millimeters)
    except Exception as ex:
        error_logs.append(f"Room '{room_name}': Height conversion failed: {ex}")
        continue

    # 4) Set "Height Offset From Level"
    param = revit_ceiling.LookupParameter("Height Offset From Level")
    if param:
        try:
            TransactionManager.Instance.EnsureInTransaction(doc)
            param.Set(h_internal)
            TransactionManager.Instance.TransactionTaskDone()
        except Exception as ex:
            error_logs.append(f"Room '{room_name}': Setting offset failed: {ex}")
            # ensure transaction closed
            try:
                TransactionManager.Instance.TransactionTaskDone()
            except:
                pass
            continue
    else:
        error_logs.append(f"Room '{room_name}': Parameter 'Height Offset From Level' not found.")
        continue

    # 5) Record success
    created_ceilings.append(ceiling_wrapper)

# OUT: (created_ceilings, error_logs)
OUT = (created_ceilings, error_logs)
# ----------------------------------------
code_block_4 = CodeBlock { 5; 1; 5; 1; }
실링_생성_new = Python(IN[0]=ceiling_types, IN[1]=라인_시각화, IN[2]=getItemAtIndex, IN[3]=lastItem, IN[4]=getItemAtIndex_2, IN[5]=code_block_4.out0, IN[6]=code_block_4.out1, IN[7]=code_block_4.out2, IN[8]=code_block_4.out3)  # CPython3; frozen
# ---------- 실링_생성_new.python (157 lines) ----------
# Dynamo Python Script for Ceiling Creation with Room Names and Error Logging
# IN[0] : CeilingType (Revit.Elements.CeilingType)
# IN[1] : List of curve lists            (List of Autodesk.DesignScript.Geometry.Curve[] or single Curve)
# IN[2] : List of room name strings      (List of str)
# IN[3] : List of Level objects          (List of Revit.Elements.Level)
# IN[4] : List of heights in mm (double) (List of float)
# IN[5] : Threshold in mm for sliver curves (double), e.g. 5.0
# IN[6] : Buffer distance in mm for fallback offset (double), e.g. 1.0

import clr, math

# --- Dynamo & Revit Elements ---
clr.AddReference('ProtoGeometry')
from Autodesk.DesignScript.Geometry import Curve, PolyCurve, Line, Vector

clr.AddReference('RevitNodes')
import Revit
clr.ImportExtensions(Revit.Elements)

clr.AddReference('RevitAPI')
from Autodesk.Revit.DB import UnitUtils, UnitTypeId

clr.AddReference('RevitServices')
from RevitServices.Persistence import DocumentManager
from RevitServices.Transactions import TransactionManager

doc = DocumentManager.Instance.CurrentDBDocument

# Inputs
ceiling_type  = IN[0]
curve_lists   = IN[1]
room_names    = IN[2]
levels        = IN[3]
heights_mm    = IN[4]
threshold_mm  = IN[5]
buffer_mm     = IN[6]

# Internal constants (기본값)
angle_tol_deg = 5.0    # 병합 허용 각도 (°)
gap_tol_mm    = 1.0    # 인접 간격 허용치 (mm)

# Unit conversions
threshold_m = threshold_mm / 1000.0
buffer_m    = buffer_mm    / 1000.0
gap_tol_m   = gap_tol_mm   / 1000.0

created_ceilings = []
error_logs       = []

def try_make_loop(curves):
    try:
        pc = PolyCurve.ByJoinedCurves(curves)
        return pc if pc.IsClosed else None
    except:
        return None

def merge_colinear_segments(segments, angle_tol, gap_tol):
    used = set()
    merged = []
    for i, seg in enumerate(segments):
        if i in used: continue
        group = [seg]; used.add(i)
        v1 = Vector.ByTwoPoints(seg.StartPoint, seg.EndPoint).Normalized()
        for j, other in enumerate(segments):
            if j in used: continue
            v2 = Vector.ByTwoPoints(other.StartPoint, other.EndPoint).Normalized()
            ang = abs(v1.AngleTo(v2) * 180.0 / math.pi)
            ang = min(ang, abs(180-ang))
            if ang <= angle_tol:
                dists = [
                    seg.StartPoint.DistanceTo(other.StartPoint),
                    seg.StartPoint.DistanceTo(other.EndPoint),
                    seg.EndPoint  .DistanceTo(other.StartPoint),
                    seg.EndPoint  .DistanceTo(other.EndPoint),
                ]
                if min(dists) <= gap_tol:
                    group.append(other); used.add(j)
        pts = []
        for g in group:
            pts.extend([g.StartPoint, g.EndPoint])
        p1, p2 = max(
            ((a,b) for a in pts for b in pts),
            key=lambda ab: ab[0].DistanceTo(ab[1])
        )
        merged.append(Line.ByStartPointEndPoint(p1, p2))
    return merged

# Main loop
for curves, room_name, lvl, h_mm in zip(curve_lists, room_names, levels, heights_mm):
    # 1) Normalize
    try:
        curves_seq = list(curves)
    except:
        curves_seq = [curves]

    # 2) Remove slivers
    filtered = [c for c in curves_seq if c.Length >= threshold_m]
    if not filtered:
        error_logs.append(f"Room '{room_name}': 모든 커브가 {threshold_mm}mm 이하라 제거됨.")
        continue

    # 3) Merge colinear segments
    merged = merge_colinear_segments(filtered, angle_tol_deg, gap_tol_m)

    # 4) Try closed loop
    loop = try_make_loop(merged)
    # 5) Fallback: buffer offset → join → offset back → join
    if loop is None:
        out_segs = [Curve.Offset(c, buffer_m) for c in merged]
        tmp     = try_make_loop(out_segs)
        if tmp:
            in_segs = [Curve.Offset(c, -buffer_m) for c in tmp.Curves()]
            loop    = try_make_loop(in_segs)
    if loop is None:
        error_logs.append(f"Room '{room_name}': PolyCurve 생성 실패 (버퍼 fallback 포함).")
        continue

    # 6) Extract outline
    try:
        outline = list(loop.Curves())
    except:
        outline = [loop]

    # 7) Create ceiling
    try:
        cw = Revit.Elements.Ceiling.ByOutlineTypeAndLevel(outline, ceiling_type, lvl)
    except Exception as ex:
        error_logs.append(f"Room '{room_name}': Ceiling 생성 실패: {ex}")
        continue

    # 8) Set height offset
    rev_ceil = cw.InternalElement
    try:
        h_int = UnitUtils.ConvertToInternalUnits(h_mm, UnitTypeId.Millimeters)
    except Exception as ex:
        error_logs.append(f"Room '{room_name}': 높이 변환 실패: {ex}")
        continue

    param = rev_ceil.LookupParameter("Height Offset From Level")
    if not param:
        error_logs.append(f"Room '{room_name}': 'Height Offset From Level' 파라미터 없음.")
        continue

    try:
        TransactionManager.Instance.EnsureInTransaction(doc)
        param.Set(h_int)
        TransactionManager.Instance.TransactionTaskDone()
    except Exception as ex:
        error_logs.append(f"Room '{room_name}': Offset 설정 실패: {ex}")
        try: TransactionManager.Instance.TransactionTaskDone()
        except: pass
        continue

    created_ceilings.append(cw)

# OUT
OUT = (created_ceilings, error_logs)
# ----------------------------------------
