# Dynamo graph 룸별 오프닝 면적 계산기.dyn (Dynamo 3.3.0.6316)

categories = Categories("OST_Rooms")
all_elements_of_category = ElementsOfCategory(Category=categories)
parameters = Element.Parameters(element=all_elements_of_category)
categories_2 = Categories("OST_Doors")
all_elements_of_category_2 = ElementsOfCategory(Category=categories_2)
categories_3 = Categories("OST_Windows")
all_elements_of_category_3 = ElementsOfCategory(Category=categories_3)
join = List.Join(list0=all_elements_of_category_2, list1=all_elements_of_category_3)
integer_slider = IntegerSlider(3, range=0..13 step 1)
code_block = CodeBlock(i=all_elements_of_category, j=integer_slider) { i[j]; }
geometry = Element.Geometry(element=code_block)
code_block_2 = CodeBlock(i=geometry) { i[0]; }
geometry_2 = Element.Geometry(element=join)
byUnion = Solid.ByUnion(solids=geometry_2)
doesIntersect = Geometry.DoesIntersect(geometry=code_block_2, other=byUnion)
filterByBoolMask = List.FilterByBoolMask(list=join, mask=doesIntersect)
code_block_3 = CodeBlock { "Area"; }
getParameterValueByName = Element.GetParameterValueByName(element=filterByBoolMask.in, parameterName=code_block_3)
sum = Math.Sum(values=getParameterValueByName)
