# Dynamo graph 스케치tool.dyn (Dynamo 2.16.1.2727)

n1_경간_입력_x방향 = StringInput("5 6 5")  # "1. 경간 입력(x방향)"; graph input
n2_경간_입력_y방향 = StringInput("4 5")  # "2. 경간 입력(y방향)"; graph input
n3_층고_입력 = StringInput("4 4 4")  # "3. 층고 입력"; graph input

# group: 그리드용 좌표 형성
code_block = CodeBlock { " "; }
split = String.Split(string=n1_경간_입력_x방향, separator0=code_block)
toNumber = String.ToNumber(string=split)
code_block_2 = CodeBlock { " "; }
split_2 = String.Split(string=n2_경간_입력_y방향, separator0=code_block_2)
toNumber_2 = String.ToNumber(string=split_2)
code_block_3 = CodeBlock { " "; }
split_3 = String.Split(string=n3_층고_입력, separator0=code_block_3)
toNumber_3 = String.ToNumber(string=split_3)
list_create = List.Create(item0=toNumber, item1=toNumber_2, item2=toNumber_3)
findAllGridPts = Python(IN[0]=list_create)  # CPython3
# ---------- findAllGridPts.python (85 lines) ----------
# Load the Python Standard and DesignScript Libraries
import sys
import clr
clr.AddReference('ProtoGeometry')
from Autodesk.DesignScript.Geometry import *

################Module For Functional Programing#########################
from functools import reduce; from itertools import chain
from itertools import groupby; import operator
from copy import deepcopy
curry = lambda f: lambda a,*args: f(a, *args) if (len(args)) else lambda *args: f(a, *args)

filter, map, reduce = curry(filter), curry(map), curry(reduce)

go = lambda *args: reduce(lambda a,f: f(a), args) ## 함수도 축약 가능 ##

def dictUpdate(dic1,dic2):
    dic1.update(dic2)
    return dic1
    
def dictsMerge(dics):
    res = reduce(dictUpdate, dics)
    return res
    
def dictDeleteKeys(dic, keys):
    for k in keys:
        del dic[k]
    return dic

def flat(a):
    if isinstance(a, list):
        for i in a: 
            yield from flat(i)
    else: yield a

def grpBy(iter, key):
    f,keys,grps = key,[],[]
    sorted_ = sorted(iter, key=f)
    for key, grp_data in groupby(sorted_,key=f):
        keys.append(key); grps.append(list(grp_data))
    return grps,keys
#########################################################################
# The inputs to this node will be stored as a list in the IN variables.
dataEnteringNode = IN
inputSpan = IN[0]
# Place your code below this line
def create_inputSpanInfo(inputSpan):
    xSpans, ySpans, stories  = inputSpan
    return {"xSpans": xSpans, "ySpans": ySpans, "stories": stories}


def findAllGridPts(spanInfo, sttPt=[0,0,0]):
    xSpans = spanInfo["xSpans"]
    ySpans = spanInfo["ySpans"]
    stories = spanInfo["stories"]
    # 첫줄 만들기
    firstRowPts = [sttPt]
    newPt = deepcopy(sttPt)
    for x in xSpans:
        newPt[0] = newPt[0] + x
        firstRowPts.append(deepcopy(newPt))
    # 그 다음 줄 들 만들기
    firstFl = [firstRowPts]
    nextRowPts = deepcopy(firstRowPts)
    for y in ySpans:
        for pt in nextRowPts:
            pt[1] = pt[1] + y
        firstFl.append(deepcopy(nextRowPts))
    
    allFls = [firstFl]
    nextFl = deepcopy(firstFl)
    for z in stories:
        for row in nextFl:
            for pt in row:
                pass
                pt[2] = pt[2] + z
        allFls.append(deepcopy(nextFl))
    
    return allFls

spanInfo = create_inputSpanInfo(inputSpan)

res = findAllGridPts(spanInfo)
# Assign your output to the OUT variable.
OUT = res
# ----------------------------------------

# group: 그리드용 포인트 형성
code_block_4 = CodeBlock { 1000; }
mul = findAllGridPts * code_block_4
code_block_5 = CodeBlock { 0; 1; 2; }
getItemAtIndex = List.GetItemAtIndex(list=mul@@L2, index=code_block_5.out0)
getItemAtIndex_2 = List.GetItemAtIndex(list=mul@@L2, index=code_block_5.out1)
getItemAtIndex_3 = List.GetItemAtIndex(list=mul@@L2, index=code_block_5.out2)
byCoordinates = Point.ByCoordinates(x=getItemAtIndex, y=getItemAtIndex_2, z=getItemAtIndex_3)

# group: 그리드 격자 형성
firstItem = List.FirstItem(list=byCoordinates)
firstItem_2 = List.FirstItem(list=firstItem@L2)
lastItem = List.LastItem(list=firstItem@L2)
byStartPointEndPoint = Line.ByStartPointEndPoint(startPoint=firstItem_2, endPoint=lastItem)
transpose = List.Transpose(lists=firstItem)
firstItem_3 = List.FirstItem(list=transpose@L2)
lastItem_2 = List.LastItem(list=transpose@L2)
byStartPointEndPoint_2 = Line.ByStartPointEndPoint(startPoint=firstItem_3, endPoint=lastItem_2)
list_create_2 = List.Create(item0=byStartPointEndPoint, item1=byStartPointEndPoint_2)
code_block_6 = CodeBlock { 3000; }
extendEnd = Curve.ExtendEnd(curve=list_create_2, distance=code_block_6)
extendStart = Curve.ExtendStart(curve=extendEnd, distance=code_block_6)
byLine = Grid.ByLine(line=extendStart)

x간격 = CodeBlock { "5 6 5"; }
y간격 = CodeBlock { "4 5"; }
층_간격 = CodeBlock { "4 4 4"; }

# group: 기둥용 라인 형성
code_block_7 = CodeBlock { 0..1; 1; }
sublists = List.Sublists(list=byCoordinates, ranges=code_block_7.out0, offset=code_block_7.out1)
transpose_2 = List.Transpose(lists=sublists@L6)
firstItem_4 = List.FirstItem(list=transpose_2@L4)
code_block_8 = CodeBlock { -1; }
dropItems = List.DropItems(list=firstItem_4, amount=code_block_8)
lastItem_3 = List.LastItem(list=transpose_2@L4)
code_block_9 = CodeBlock { -1; }
dropItems_2 = List.DropItems(list=lastItem_3, amount=code_block_9)
byStartPointEndPoint_3 = Line.ByStartPointEndPoint(startPoint=dropItems, endPoint=dropItems_2, lacing=Shortest)

flatten = List.Flatten(list=byStartPointEndPoint_3@L3)

# group: 레벨용 Elevation 생성
add = _ + _  # unwired: x, y
code_block_10 = CodeBlock { 0; }
code_block_11 = CodeBlock { 1000; }
mul_2 = toNumber_3 * code_block_11
scan = ScanList(reduceFunction=add, seed=code_block_10, list0=mul_2)  # "List.Scan"

# group: 레벨 생성
categories = Categories("OST_Levels")
all_elements_of_category = ElementsOfCategory(Category=categories)
elevation = Level.Elevation(level=all_elements_of_category)
contains = List.Contains(list=elevation, item=scan@L1)
filterByBoolMask = List.FilterByBoolMask(list=scan, mask=contains)
byElevation = Level.ByElevation(elevation=filterByBoolMask.out)

join = List.Join(list0=all_elements_of_category, list1=byElevation)
code_block_12 = CodeBlock(allLevels=join) { allLevels; }
code_block_13 = CodeBlock { -1; }
dropItems_3 = List.DropItems(list=code_block_12, amount=code_block_13)

# group: 기둥 생성
structural_column_types = StructuralColumnTypes("UC305x305x97")  # graph input
columnByCurve = StructuralFraming.ColumnByCurve(curve=flatten, level=dropItems_3, structuralColumnType=structural_column_types)  # frozen

빔거더용_라인_형성 = Python(IN[0]=byCoordinates)  # CPython3
# ---------- 빔거더용_라인_형성.python (72 lines) ----------
# Load the Python Standard and DesignScript Libraries
import sys
import clr
clr.AddReference('ProtoGeometry')
from Autodesk.DesignScript.Geometry import *

################Module For Functional Programing#########################
from functools import reduce; from itertools import chain
from itertools import groupby; import operator
from copy import deepcopy
curry = lambda f: lambda a,*args: f(a, *args) if (len(args)) else lambda *args: f(a, *args)

filter, map, reduce = curry(filter), curry(map), curry(reduce)

go = lambda *args: reduce(lambda a,f: f(a), args) ## 함수도 축약 가능 ##

def dictUpdate(dic1,dic2):
    dic1.update(dic2)
    return dic1
    
def dictsMerge(dics):
    res = reduce(dictUpdate, dics)
    return res
    
def dictDeleteKeys(dic, keys):
    for k in keys:
        del dic[k]
    return dic

def flat(a):
    if isinstance(a, list):
        for i in a: 
            yield from flat(i)
    else: yield a

def grpBy(iter, key):
    f,keys,grps = key,[],[]
    sorted_ = sorted(iter, key=f)
    for key, grp_data in groupby(sorted_,key=f):
        keys.append(key); grps.append(list(grp_data))
    return grps,keys
#########################################################################

# The inputs to this node will be stored as a list in the IN variables.
dataEnteringNode = IN
ptsPerLevel = IN[0]
# Place your code below this line
ptsPerLevelExcept0F = ptsPerLevel[1:]
trPtsPerLevelExcept0F = go(
    ptsPerLevelExcept0F,list,
    map(lambda grp: list(zip(*grp))),
)

def makeLineInGrp(lvGrp):
    res = []
    for row in lvGrp:
        rowLines = go(
            row,len,range,
            map(lambda x: row[x:x+2]),list,
            filter(lambda x: len(x)>=2),
            map(lambda x: Line.ByStartPointEndPoint(*x))
        )
        res.append(rowLines)
    return res

def makeLinePerLvGrp(ptsPerLevel):
    res = list(map(makeLineInGrp, ptsPerLevel))
    return res

res = list(zip(makeLinePerLvGrp(ptsPerLevelExcept0F), makeLinePerLvGrp(trPtsPerLevelExcept0F)))
# Assign your output to the OUT variable.
OUT = res
# ----------------------------------------
flatten_2 = List.Flatten(list=빔거더용_라인_형성@L4)
code_block_14 = CodeBlock(girdersPerLevel=flatten_2) { girdersPerLevel; }

# group: 거더 생성
restOfItems = List.RestOfItems(list=code_block_12)
structural_framing_types = StructuralFramingTypes("UB305x165x40")  # graph input
braceByCurve = StructuralFraming.BraceByCurve(curve=code_block_14, level=restOfItems, structuralFramingType=structural_framing_types)  # frozen

n4_경간_내_빔_개수 = StringInput("3")  # "4. 경간 내 빔 개수"; graph input
startPoint = Curve.StartPoint(curve=code_block_14)
Z = Point.Z(point=startPoint)
code_block_15 = CodeBlock(allLevels=join) { allLevels; }
elevation_2 = Level.Elevation(level=code_block_15)
code_block_16 = CodeBlock(i=elevation_2) { i>0; }
filterByBoolMask_2 = List.FilterByBoolMask(list=elevation_2, mask=code_block_16)
