# Dynamo graph 페인트 적용면적 추출 테스트.dyn (Dynamo 3.3.0.6316)

select_model_element = DSModelElementSelection()  # 1 picked in the model
python_script = Python(IN[0]=select_model_element)  # CPython3
# ---------- python_script.python (25 lines) ----------
import clr
clr.AddReference('RevitAPI')
from Autodesk.Revit.DB import *

clr.AddReference('RevitServices')
from RevitServices.Persistence import DocumentManager
doc = DocumentManager.Instance.CurrentDBDocument

element = UnwrapElement(IN[0])
opt = Options()
geom = element.get_Geometry(opt)

individual_faces = []  # (재질명, 면적) 튜플 리스트

for geom_obj in geom:
    if hasattr(geom_obj, 'Faces'):
        for face in geom_obj.Faces:
            mat_id = doc.GetPaintedMaterial(element.Id, face)
            if mat_id and mat_id.IntegerValue != -1:
                material = doc.GetElement(mat_id)
                mat_name = material.Name
                area = face.Area  # ft² 단위
                individual_faces.append((mat_name, area))

OUT = individual_faces
# ----------------------------------------
python_script_2 = Python()  # CPython3; frozen; unwired: IN[0]
# ---------- python_script_2.python (14 lines) ----------
import sqlite3
import urllib.request

db_path = 'D:/shared/bnote_sample.db'
conn = sqlite3.connect(db_path)
cursor = conn.cursor()

# 예: 데이터 추가
cursor.execute("INSERT INTO standard_nodes (name, path, level, std_values) VALUES (?, ?, ?, ?)",
               ("계단", '["건축", "내부계단"]', 2, '["노출콘크리트"]'))

conn.commit()
conn.close()
OUT = "저장 완료"
# ----------------------------------------
parameters = Element.Parameters(element=select_model_element)
python_script_3 = Python(IN[0]=select_model_element)  # CPython3
# ---------- python_script_3.python (36 lines) ----------
# Dynamo Python (IronPython) 예제
import clr
clr.AddReference('RevitAPI')
clr.AddReference('RevitServices')
from Autodesk.Revit.DB import *
from RevitServices.Persistence import DocumentManager

doc = DocumentManager.Instance.CurrentDBDocument
element = UnwrapElement(IN[0])

opts = Options()
geomElem = element.get_Geometry(opts)

results = []  # [(materialId, faceId, area), ...]

for geomObj in geomElem:
    solid = geomObj if isinstance(geomObj, Solid) else None
    if solid and solid.Faces.Size > 0:
        for face in solid.Faces:
            # 해당 면이 페인트된 면인지 확인
            matId = doc.GetPaintedMaterial(element.Id, face)
            if matId.IntegerValue != ElementId.InvalidElementId.IntegerValue:
                # PlanarFace이면 .Area 사용
                if isinstance(face, PlanarFace):
                    area = face.Area
                    # :contentReference[oaicite:4]{index=4}
                else:
                    # 비평면(face)은 메시로 근사 계산
                    mesh = face.Triangulate()
                    area = mesh.ComputeSurfaceArea()
                    # :contentReference[oaicite:5]{index=5}

                results.append((matId, face.Id, area))

# OUT[0]에 결과 출력
OUT = results
# ----------------------------------------
python_script_4 = Python(IN[0]=select_model_element)  # CPython3
# ---------- python_script_4.python (35 lines) ----------
import clr
# Revit API 참조
clr.AddReference('RevitAPI')
from Autodesk.Revit.DB import *

# Dynamo → Revit 문서 접근
clr.AddReference('RevitServices')
from RevitServices.Persistence import DocumentManager

# 현재 문서 가져오기
doc = DocumentManager.Instance.CurrentDBDocument

# Dynamo 입력: 단일 요소 (IN[0])
element = UnwrapElement(IN[0])

# 결과를 담을 리스트 [(재질명, 총면적), ...]
results = []

# ① 기본(material) 및 프로젝트 Paint Override 재질 ID 모두 가져오기
#    False: 기본(material) 포함, True: Paint Override만
material_ids = element.GetMaterialIds(False)
print(material_ids)

# ② 각 재질별 총면적 계산
for mat_id in material_ids:
    # mat_id가 유효한 경우에만
    if mat_id != ElementId.InvalidElementId:
        mat_elem = doc.GetElement(mat_id)
        mat_name = mat_elem.Name
        # False: 기본(material) 포함, True: Paint Override만
        area = element.GetMaterialArea(mat_id, False)
        results.append((mat_name, area))

# Dynamo 출력
OUT = results
# ----------------------------------------
geometry = Element.Geometry(element=select_model_element)
area = Solid.Area(solid=geometry)
