# Dynamo graph 프레임 자동생성_[1.0.2]_GD.dyn (Dynamo 2.16.1.2727)
# packages: GenerativeDesign 3.0.16.0

x간격 = CodeBlock { "5 6 5"; }
y간격 = CodeBlock { "4 5"; }
층_간격 = CodeBlock { "4 4 4"; }
n1_x방향_경간_입력_m = StringInput("5 6 5 6")  # "1. x방향 경간 입력(m)"
n2_y방향_경간_입력_m = StringInput("4 5 4")  # "2. y방향 경간 입력(m)"
n3_층고_입력_m = StringInput("""4
3.5""")  # "3. 층고 입력(m)"
n01_건물_가로_너비 = DoubleInput(22)  # "01. 건물 가로 너비"; graph input
g1_가로_경간_수_var = IntegerSlider(7, range=3..8 step 1)  # graph input
get_xSpans = Python(IN[0]=n01_건물_가로_너비, IN[1]=g1_가로_경간_수_var)  # CPython3
# ---------- get_xSpans.python (65 lines) ----------
# Load the Python Standard and DesignScript Libraries
import sys
import clr
clr.AddReference('ProtoGeometry')
from Autodesk.DesignScript.Geometry import *
################Module For Functional Programing#########################
from functools import reduce; from itertools import chain
from itertools import groupby; import operator
from copy import deepcopy
curry = lambda f: lambda a,*args: f(a, *args) if (len(args)) else lambda *args: f(a, *args)

filter, map, reduce = curry(filter), curry(map), curry(reduce)

go = lambda *args: reduce(lambda a,f: f(a), args) ## 함수도 축약 가능 ##

def dictUpdate(dic1,dic2):
    dic1.update(dic2)
    return dic1
    
def dictsMerge(dics):
    res = reduce(dictUpdate, dics)
    return res
    
def dictDeleteKeys(dic, keys):
    for k in keys:
        del dic[k]
    return dic

def flat(a):
    if isinstance(a, list):
        for i in a: 
            yield from flat(i)
    else: yield a

def grpBy(iter, key):
    f,keys,grps = key,[],[]
    sorted_ = sorted(iter, key=f)
    for key, grp_data in groupby(sorted_,key=f):
        keys.append(key); grps.append(list(grp_data))
    return grps,keys
#########################################################################
# The inputs to this node will be stored as a list in the IN variables.
dataEnteringNode = IN
bd_Width = IN[0]
spanCnt = IN[1]
# Place your code below this line

def get_minSpanWidth(bd_Width, spanCnt):
    minSpan = bd_Width // spanCnt
    remain = bd_Width % spanCnt
    spans = [minSpan] * spanCnt
    
    if spanCnt % 2 == 0:
        spans_midIdx = (spanCnt // 2) - 1
    else:
        spans_midIdx = (spanCnt // 2)
    # 각 span에 잔여 길이 분배 - 중간 부터
    tgtIdxes = list(range(spans_midIdx, spans_midIdx + remain))
    
    for i in tgtIdxes:
        spans[i] += 1
    
    return spans
# Assign your output to the OUT variable.
OUT = get_minSpanWidth(bd_Width, spanCnt)
# ----------------------------------------
code_block = CodeBlock(xSpans=get_xSpans) { xSpans; }
n02_건물_세로_너비 = DoubleInput(13)  # "02. 건물 세로 너비"; graph input
g2_세로_경간_수_var = IntegerSlider(6, range=2..6 step 1)  # graph input
get_ySpans = Python(IN[0]=n02_건물_세로_너비, IN[1]=g2_세로_경간_수_var)  # CPython3; same code as get_xSpans
code_block_2 = CodeBlock(ySpans=get_ySpans) { ySpans; }
n03_층고_입력_m = StringInput("""4
3.5""")  # "03. 층고 입력(m)"; graph input
code_block_3 = CodeBlock { " "; "\n"; }
split = String.Split(string=n03_층고_입력_m, separator0=code_block_3.out0, separator1=code_block_3.out1)
toNumber = String.ToNumber(string=split)

# group: 그리드용 좌표 형성
code_block_4 = CodeBlock { " "; "\n"; }
split_2 = String.Split(string=n1_x방향_경간_입력_m, separator0=code_block_4.out0, separator1=code_block_4.out1)  # frozen
toNumber_2 = String.ToNumber(string=split_2)
code_block_5 = CodeBlock { " "; "\n"; }
split_3 = String.Split(string=n2_y방향_경간_입력_m, separator0=code_block_5.out0, separator1=code_block_5.out1)  # frozen
toNumber_3 = String.ToNumber(string=split_3)
code_block_6 = CodeBlock { " "; "\n"; }
split_4 = String.Split(string=n3_층고_입력_m, separator0=code_block_6.out0, separator1=code_block_6.out1)  # frozen
toNumber_4 = String.ToNumber(string=split_4)
code_block_7 = CodeBlock(stories=toNumber) { stories; }
list_create = List.Create(item0=code_block, item1=code_block_2, item2=code_block_7)
findAllGridPts = Python(IN[0]=list_create)  # CPython3
# ---------- findAllGridPts.python (85 lines) ----------
# Load the Python Standard and DesignScript Libraries
import sys
import clr
clr.AddReference('ProtoGeometry')
from Autodesk.DesignScript.Geometry import *

################Module For Functional Programing#########################
from functools import reduce; from itertools import chain
from itertools import groupby; import operator
from copy import deepcopy
curry = lambda f: lambda a,*args: f(a, *args) if (len(args)) else lambda *args: f(a, *args)

filter, map, reduce = curry(filter), curry(map), curry(reduce)

go = lambda *args: reduce(lambda a,f: f(a), args) ## 함수도 축약 가능 ##

def dictUpdate(dic1,dic2):
    dic1.update(dic2)
    return dic1
    
def dictsMerge(dics):
    res = reduce(dictUpdate, dics)
    return res
    
def dictDeleteKeys(dic, keys):
    for k in keys:
        del dic[k]
    return dic

def flat(a):
    if isinstance(a, list):
        for i in a: 
            yield from flat(i)
    else: yield a

def grpBy(iter, key):
    f,keys,grps = key,[],[]
    sorted_ = sorted(iter, key=f)
    for key, grp_data in groupby(sorted_,key=f):
        keys.append(key); grps.append(list(grp_data))
    return grps,keys
#########################################################################
# The inputs to this node will be stored as a list in the IN variables.
dataEnteringNode = IN
inputSpan = IN[0]
# Place your code below this line
def create_inputSpanInfo(inputSpan):
    xSpans, ySpans, stories  = inputSpan
    return {"xSpans": xSpans, "ySpans": ySpans, "stories": stories}


def findAllGridPts(spanInfo, sttPt=[0,0,0]):
    xSpans = spanInfo["xSpans"]
    ySpans = spanInfo["ySpans"]
    stories = spanInfo["stories"]
    # 첫줄 만들기
    firstRowPts = [sttPt]
    newPt = deepcopy(sttPt)
    for x in xSpans:
        newPt[0] = newPt[0] + x
        firstRowPts.append(deepcopy(newPt))
    # 그 다음 줄 들 만들기
    firstFl = [firstRowPts]
    nextRowPts = deepcopy(firstRowPts)
    for y in ySpans:
        for pt in nextRowPts:
            pt[1] = pt[1] + y
        firstFl.append(deepcopy(nextRowPts))
    
    allFls = [firstFl]
    nextFl = deepcopy(firstFl)
    for z in stories:
        for row in nextFl:
            for pt in row:
                pass
                pt[2] = pt[2] + z
        allFls.append(deepcopy(nextFl))
    
    return allFls

spanInfo = create_inputSpanInfo(inputSpan)

res = findAllGridPts(spanInfo)
# Assign your output to the OUT variable.
OUT = res
# ----------------------------------------

# group: 그리드용 포인트 형성
code_block_8 = CodeBlock { 1000; }
mul = findAllGridPts * code_block_8
code_block_9 = CodeBlock { 0; 1; 2; }
getItemAtIndex = List.GetItemAtIndex(list=mul@@L2, index=code_block_9.out0)
getItemAtIndex_2 = List.GetItemAtIndex(list=mul@@L2, index=code_block_9.out1)
getItemAtIndex_3 = List.GetItemAtIndex(list=mul@@L2, index=code_block_9.out2)
byCoordinates = Point.ByCoordinates(x=getItemAtIndex, y=getItemAtIndex_2, z=getItemAtIndex_3)

# group: 루프층 가운데 열 기둥 추출 - 전체 파이썬으로 축약하고 리스트 구조 유지한채로 가운데 열 포인트만 입력받은 구배 높이 만큼 높여서 반환하도록 수정 요
code_block_10 = CodeBlock(i=byCoordinates) { i; }
Y = Point.Y(point=code_block_10)
flatten = List.Flatten(list=Y)
uniqueItems = List.UniqueItems(list=flatten)
중간_항목_구하기 = Python(IN[0]=uniqueItems)  # CPython3
# ---------- 중간_항목_구하기.python (15 lines) ----------
# Load the Python Standard and DesignScript Libraries
import sys
import clr
clr.AddReference('ProtoGeometry')
from Autodesk.DesignScript.Geometry import *

# The inputs to this node will be stored as a list in the IN variables.
dataEnteringNode = IN
iter = IN[0]
# Place your code below this line

res = len(iter) // 2

# Assign your output to the OUT variable.
OUT = res
# ----------------------------------------
getItemAtIndex_4 = List.GetItemAtIndex(list=code_block_10@L3, index=중간_항목_구하기)
lastItem = List.LastItem(list=getItemAtIndex_4)

n4_루프_구배_gap_height_m = DoubleInput(0.6)  # "4. 루프 구배 Gap Height(m)"; graph input
code_block_11 = CodeBlock(roofGap=n4_루프_구배_gap_height_m) { roofGap*1000; }
루프층_가운데_열_상단점_레벨_상승 = Python(IN[0]=code_block_10, IN[1]=code_block_11)  # CPython3
# ---------- 루프층_가운데_열_상단점_레벨_상승.python (73 lines) ----------
# Load the Python Standard and DesignScript Libraries
import sys
import clr
clr.AddReference('ProtoGeometry')
from Autodesk.DesignScript.Geometry import *

################Module For Functional Programing#########################
from functools import reduce
from itertools import chain
from itertools import groupby
from copy import deepcopy
curry = lambda f: lambda a,*args: f(a, *args) if (len(args)) else lambda *args: f(a, *args)

filter,map,reduce = curry(filter),curry(map),curry(reduce)

go = lambda *args: reduce(lambda a,f: f(a), args) ## 함수도 축약 가능 ##

def dictUpdate(dic1,dic2):
    dic1.update(dic2)
    return dic1
    
def dictsMerge(dics):
    res = reduce(dictUpdate, dics)
    return res
    
def dictDeleteKeys(dic, keys):
    for k in keys:
        del dic[k]
    return dic

def flat(a):
    if isinstance(a, list):
        for i in a: 
            yield from flat(i)
    else: yield a
      
def grpBy(iter, key):
    f,grpKeys,grps = key,[],[]
    sorted_ = sorted(iter, key=f)
    for key, grp_data in groupby(sorted_,key=f):
        grpKeys.append(key); grps.append(list(grp_data))
    return grps,grpKeys
#########################################################################

# The inputs to this node will be stored as a list in the IN variables.
dataEnteringNode = IN
ptsPerLevel = IN[0]
slopeGap = IN[1]
# Place your code below this line

def getMid_inTopLevel(roofLvPts):
    res = go(
        roofLvPts,
        len,
        lambda x: x//2,
    )
    return res

def modifyToplevelMid(ptsPerLevel, slopeGap):
    roofLvPts = ptsPerLevel[-1]
    otherLvPts = ptsPerLevel[:-1]
    midIdx = getMid_inTopLevel(roofLvPts)
    roofMidRowPts = list(roofLvPts[midIdx])
    trsRoofMidRowPts = go(
        roofMidRowPts,
        map(lambda x: x.Translate(0,0,slopeGap)),
    )
    roofLvPts[midIdx] = trsRoofMidRowPts
    
    return otherLvPts + [roofLvPts]

# Assign your output to the OUT variable.
OUT = modifyToplevelMid(ptsPerLevel,slopeGap)
# ----------------------------------------

# group: 기둥용 라인 형성
code_block_12 = CodeBlock { 0..1; 1; }
# note: 가운데 기둥 열 들 높이 올리기 구간 추가 필요
sublists = List.Sublists(list=루프층_가운데_열_상단점_레벨_상승, ranges=code_block_12.out0, offset=code_block_12.out1)
transpose = List.Transpose(lists=sublists@L6)
firstItem = List.FirstItem(list=transpose@L4)
code_block_13 = CodeBlock { -1; }
dropItems = List.DropItems(list=firstItem, amount=code_block_13)
lastItem_2 = List.LastItem(list=transpose@L4)
code_block_14 = CodeBlock { -1; }
dropItems_2 = List.DropItems(list=lastItem_2, amount=code_block_14)
byStartPointEndPoint = Line.ByStartPointEndPoint(startPoint=dropItems, endPoint=dropItems_2, lacing=Shortest)

flatten_2 = List.Flatten(list=byStartPointEndPoint)
code_block_15 = CodeBlock(roofGap=code_block_11) { roofGap; }
code_block_16 = CodeBlock(roofGap=code_block_15) { roofGap; }
modify_slope_roof_points = Python(IN[0]=flatten_2, IN[1]=dropItems_2, IN[2]=code_block_16)  # CPython3
# ---------- modify_slope_roof_points.python (182 lines) ----------
# Load the Python Standard and DesignScript Libraries
import sys
import clr
clr.AddReference('ProtoGeometry')
from Autodesk.DesignScript.Geometry import *
################Module For Functional Programing#########################
from functools import reduce; from itertools import chain
from itertools import groupby; import operator
from copy import deepcopy
curry = lambda f: lambda a,*args: f(a, *args) if (len(args)) else lambda *args: f(a, *args)

filter, map, reduce = curry(filter), curry(map), curry(reduce)

go = lambda *args: reduce(lambda a,f: f(a), args) ## 함수도 축약 가능 ##

def dictUpdate(dic1,dic2):
    dic1.update(dic2)
    return dic1
    
def dictsMerge(dics):
    res = reduce(dictUpdate, dics)
    return res
    
def dictDeleteKeys(dic, keys):
    for k in keys:
        del dic[k]
    return dic

def flat(a):
    if isinstance(a, list):
        for i in a: 
            yield from flat(i)
    else: yield a

def grpBy(iter, key):
    f,keys,grps = key,[],[]
    sorted_ = sorted(iter, key=f)
    for key, grp_data in groupby(sorted_,key=f):
        keys.append(key); grps.append(list(grp_data))
    return grps,keys
#########################################################################

# The inputs to this node will be stored as a list in the IN variables.
dataEnteringNode = IN
allCols_loc = IN[0]
allEndPts_forAllLv = IN[1]
gap = IN[2]
# Place your code below this line
def index_toName(datas):
    rngsStr = list(map(str, range(len(datas))))
    allNames = go(
        rngsStr,
        map(lambda x: "0" + x if len(x) < 2 else x)
    )
    return allNames
    
def get_BuilingBdBox(allCols_loc):
    #allCols_loc = list(map(lambda x: x.GetLocation(),allCols))
    bdBox = BoundingBox.ByGeometry(allCols_loc).ToCuboid()
    return bdBox

def find_longitudinalAxis(allCols_loc):
    bdBox = get_BuilingBdBox(allCols_loc)
    btmFace_PeriLine = go(
        bdBox,
        lambda x: x.Explode(),
        filter(lambda x: x.NormalAtParameter(0.5,0.5).Z == -1),
        list, lambda x: x[0],
        lambda x: x.PerimeterCurves(),
    )
    longitudinalVec = go(
        btmFace_PeriLine,
        map(lambda x: x.Length), max,
        lambda x: filter(lambda y: y.Length == x, btmFace_PeriLine),
        list,lambda x:x[0],
        lambda x: x.Direction.Normalized(),
    )
    if longitudinalVec.X < 0 or longitudinalVec.Y < 0:
        longitudinalVec = longitudinalVec.Reverse()
    else:
        pass
    
    return longitudinalVec

# 장축 방향으로 포인트 그룹 형성
def grp_longitudinal(ptsPerLv, longitudeAxis):
    flattenPts = list(chain(*ptsPerLv))
    if longitudeAxis.X == 1:
        grpByLongi = go(
            flattenPts,
            lambda x: grpBy(x, key=lambda x: x.Y),
            list,
        )
    elif longitudeAxis.Y == 1:
        grpByLongi = go(
            flattenPts,
            lambda x: grpBy(x, key=lambda x: x.X),
            list,
        )
    grped = grpByLongi[0]
    zByRow = go(
        grped,
        map(lambda row: go(
            row,
            map(lambda x: x.Z),
            set,list,
            lambda x: x[0],
        )),list,
    )
    return grped, zByRow
    
def find_GapScan(zByRow):
    
    maxZ = max(zByRow)
    minZ = min(zByRow)
    z_gap = maxZ - minZ
    all_idx = list(range(0,len(zByRow)))
    stt_idx = all_idx[0]
    end_idx = all_idx[-1]
    maxZ_idx = zByRow.index(maxZ)
    #엣지와 가운데 열 사이에 몇 줄이 있는가 판별
    ## 상단부
    cen_upper = list(range(stt_idx+1,maxZ_idx))
    div_up_cnt = len(cen_upper)+1
    divGapUp_unit = z_gap / div_up_cnt
    divGapsUp_scan = list(map(lambda x: x*divGapUp_unit, range(1,len(cen_upper)+1)))
    
    ## 하단부
    cen_below = list(range(maxZ_idx+1,end_idx))
    div_bl_cnt = len(cen_below)+1
    divGapBl_unit = z_gap / div_bl_cnt
    divGapsBl_scan = list(map(lambda x: x*divGapBl_unit, range(1,len(cen_below)+1)))
    
    return {
        "maxZ_idx": maxZ_idx,
        "divGapsUp_scan": divGapsUp_scan,
        "divGapsBl_scan": divGapsBl_scan,
    }

def modify_ptsZ(ptsbyRows, gapScanDict):
    all_idx = list(range(0,len(ptsbyRows)))
    stt_idx = all_idx[0]
    end_idx = all_idx[-1]
    
    maxZ_idx = gapScanDict["maxZ_idx"]
    divGapsUp_scan = gapScanDict["divGapsUp_scan"]
    divGapsBl_scan = gapScanDict["divGapsBl_scan"]
    
    upperPtsRow = ptsbyRows[stt_idx+1:maxZ_idx]
    modi_upperPtsRow = go(
        zip(upperPtsRow,divGapsUp_scan),
        map(lambda row_scan: go(
            row_scan[0],
            map(lambda pt: pt.Translate(0,0,row_scan[1]) ),
        ) )
    )
    belowPtsRow = ptsbyRows[maxZ_idx+1:end_idx]
    modi_belowPtsRow = go(
        zip(belowPtsRow,divGapsBl_scan),
        map(lambda row_scan: go(
            row_scan[0],
            map(lambda pt: pt.Translate(0,0,row_scan[1]) ),
        ) )
    )
    
    return [
    ptsbyRows[stt_idx],
    *modi_upperPtsRow, 
    ptsbyRows[maxZ_idx], 
    *modi_belowPtsRow,
    ptsbyRows[end_idx]
    ]

longitudeAxis = find_longitudinalAxis(allCols_loc)
grped_longi, zByRow = grp_longitudinal(allEndPts_forAllLv[-1], longitudeAxis)
gapScanDict = find_GapScan(zByRow)
if gap > 0:
    res = [*allEndPts_forAllLv[:-1], modify_ptsZ(grped_longi, gapScanDict)]
else:
    res = allEndPts_forAllLv
# Assign your output to the OUT variable.
OUT = res
# ----------------------------------------
byStartPointEndPoint_2 = Line.ByStartPointEndPoint(startPoint=dropItems, endPoint=modify_slope_roof_points, lacing=Shortest)
flatten_3 = List.Flatten(list=byStartPointEndPoint_2@L3)
code_block_17 = CodeBlock(allColumnsLine=flatten_3) { allColumnsLine; }

# group: 레벨용 Elevation 생성
add = _ + _  # unwired: x, y
code_block_18 = CodeBlock { 0; }
code_block_19 = CodeBlock { 1000; }
mul_2 = code_block_7 * code_block_19
scan = ScanList(reduceFunction=add, seed=code_block_18, list0=mul_2)  # "List.Scan"

# group: 레벨 생성
categories = Categories("OST_Levels")
all_elements_of_category = ElementsOfCategory(Category=categories)
elevation = Level.Elevation(level=all_elements_of_category)

code_block_20 = CodeBlock { 0; }
round = Math.Round(number=elevation, digits=code_block_20)

# group (continued): 레벨 생성
contains = List.Contains(list=round, item=scan@L1)
filterByBoolMask = List.FilterByBoolMask(list=scan, mask=contains)
byElevation = Level.ByElevation(elevation=filterByBoolMask.out)

join = List.Join(list0=all_elements_of_category, list1=byElevation)
code_block_21 = CodeBlock(allLevels=join) { allLevels; }
elevation_2 = Level.Elevation(level=code_block_21)
code_block_22 = CodeBlock { 0; }
round_2 = Math.Round(number=elevation_2, digits=code_block_22)

# group: Survey Point - Project Base Point 높이차
basePoint = Coordinates.BasePoint()
surveyPoint = Coordinates.SurveyPoint()
remember = Data.Remember(surveyPoint)
Z = Point.Z(point=remember)

remember_2 = Data.Remember(basePoint)

# group (continued): Survey Point - Project Base Point 높이차
Z_2 = Point.Z(point=remember_2)
sub = Z_2 - Z

code_block_23 = CodeBlock(gap=sub) { gap; }
add_2 = round_2 + code_block_23
indexOf = List.IndexOf(list=add_2, element=code_block_23)
code_block_24 = CodeBlock { 0; }
replaceItemAtIndex = List.ReplaceItemAtIndex(list=add_2, index=indexOf, item=code_block_24)
code_block_25 = CodeBlock(allLevels=code_block_21, elevations=replaceItemAtIndex) { allLevels; elevations; }

# group: 모든 기둥 시점 높이 추출 및 유형화
startPoint = Curve.StartPoint(curve=flatten_3)
Z_3 = Point.Z(point=startPoint)
uniqueItems_2 = List.UniqueItems(list=Z_3@L2)
flatten_4 = List.Flatten(list=uniqueItems_2)

contains_2 = List.Contains(list=flatten_4, item=code_block_25.elevations@L1)
filterByBoolMask_2 = List.FilterByBoolMask(list=code_block_25.allLevels, mask=contains_2)

# group: 기둥 생성
n6_기둥_타입 = StructuralColumnTypes("H_SC_AR_S01_H-400x200x8x13")  # "6. 기둥 타입"; frozen
columnByCurve = StructuralFraming.ColumnByCurve(curve=code_block_17, level=filterByBoolMask_2.in, structuralColumnType=n6_기둥_타입)  # frozen

add_3 = filterByBoolMask.out + sub

# group: 루프층 가운데 열 기둥 추출
endPoint = Curve.EndPoint(curve=byStartPointEndPoint_2)  # frozen
Y_2 = Point.Y(point=endPoint)
flatten_5 = List.Flatten(list=Y_2)
uniqueItems_3 = List.UniqueItems(list=flatten_5)
중간_항목_구하기_2 = Python(IN[0]=uniqueItems_3)  # CPython3; same code as 중간_항목_구하기
getItemAtIndex_5 = List.GetItemAtIndex(list=byStartPointEndPoint_2@L3, index=중간_항목_구하기_2)
lastItem_3 = List.LastItem(list=getItemAtIndex_5)

빔거더용_라인_형성 = Python(IN[0]=modify_slope_roof_points, IN[1]=code_block_10, IN[2]=code_block_15)  # CPython3
# ---------- 빔거더용_라인_형성.python (77 lines) ----------
# Load the Python Standard and DesignScript Libraries
import sys
import clr
clr.AddReference('ProtoGeometry')
from Autodesk.DesignScript.Geometry import *

################Module For Functional Programing#########################
from functools import reduce; from itertools import chain
from itertools import groupby; import operator
from copy import deepcopy
curry = lambda f: lambda a,*args: f(a, *args) if (len(args)) else lambda *args: f(a, *args)

filter, map, reduce = curry(filter), curry(map), curry(reduce)

go = lambda *args: reduce(lambda a,f: f(a), args) ## 함수도 축약 가능 ##

def dictUpdate(dic1,dic2):
    dic1.update(dic2)
    return dic1
    
def dictsMerge(dics):
    res = reduce(dictUpdate, dics)
    return res
    
def dictDeleteKeys(dic, keys):
    for k in keys:
        del dic[k]
    return dic

def flat(a):
    if isinstance(a, list):
        for i in a: 
            yield from flat(i)
    else: yield a

def grpBy(iter, key):
    f,keys,grps = key,[],[]
    sorted_ = sorted(iter, key=f)
    for key, grp_data in groupby(sorted_,key=f):
        keys.append(key); grps.append(list(grp_data))
    return grps,keys
#########################################################################

# The inputs to this node will be stored as a list in the IN variables.
dataEnteringNode = IN
ptsPerLevel_new = IN[0]
ptsPerLevel_ori = IN[1][1:]
gap = IN[2]
# Place your code below this line
if gap > 0:
    ptsPerLevelExcept0F = ptsPerLevel_new#ptsPerLevel[1:]
else:
    ptsPerLevelExcept0F = ptsPerLevel_ori
trPtsPerLevelExcept0F = go(
    ptsPerLevelExcept0F,list,
    map(lambda grp: list(zip(*grp))),
)

def makeLineInGrp(lvGrp):
    res = []
    for row in lvGrp:
        rowLines = go(
            row,len,range,
            map(lambda x: row[x:x+2]),list,
            filter(lambda x: len(x)>=2),
            map(lambda x: Line.ByStartPointEndPoint(*x))
        )
        res.append(rowLines)
    return res

def makeLinePerLvGrp(ptsPerLevel):
    res = list(map(makeLineInGrp, ptsPerLevel))
    return res

res = list(zip(makeLinePerLvGrp(ptsPerLevelExcept0F), makeLinePerLvGrp(trPtsPerLevelExcept0F)))
# Assign your output to the OUT variable.
OUT = res
# ----------------------------------------
flatten_6 = List.Flatten(list=빔거더용_라인_형성@L4)
code_block_26 = CodeBlock(girdersPerLevel=flatten_6) { girdersPerLevel; }
code_block_27 = CodeBlock(allGirdersLine=code_block_26) { allGirdersLine; }
startPoint_2 = Curve.StartPoint(curve=code_block_26)
Z_4 = Point.Z(point=startPoint_2)
uniqueItems_4 = List.UniqueItems(list=Z_4@L2)
flatten_7 = List.Flatten(list=uniqueItems_4)
contains_3 = List.Contains(list=flatten_7, item=code_block_25.elevations@L1)
filterByBoolMask_3 = List.FilterByBoolMask(list=code_block_25.allLevels, mask=contains_3)

# group: 거더 생성
n7_거더_타입 = StructuralFramingTypes("H_SB_AR_S02_H-300x150x6.5x9_Stair")  # "7. 거더 타입"; frozen
beamByCurve = StructuralFraming.BeamByCurve(curve=code_block_27, level=filterByBoolMask_3.in, structuralFramingType=n7_거더_타입)  # frozen

code_block_28 = CodeBlock { "z Offset Value"; 0; }
setParameterByName = Element.SetParameterByName(element=beamByCurve, parameterName=code_block_28.out0, value=code_block_28.out1)

# group: GF이상 레벨 거더 커브 필터링
code_block_29 = CodeBlock(allLevels=join) { allLevels; }
elevation_3 = Level.Elevation(level=code_block_29)
remember_3 = Data.Remember(elevation_3)
remember_4 = Data.Remember(elevation_3)
code_block_30 = CodeBlock(i=remember_4) { i>0; }
filterByBoolMask_4 = List.FilterByBoolMask(list=remember_3, mask=code_block_30)
startPoint_3 = Curve.StartPoint(curve=code_block_26)
Z_5 = Point.Z(point=startPoint_3)
uniqueItems_5 = List.UniqueItems(list=Z_5@L2)
flatten_8 = List.Flatten(list=uniqueItems_5)

code_block_31 = CodeBlock(gap=sub) { 0; gap; }
round_3 = Math.Round(number=filterByBoolMask_4.in, digits=code_block_31.out0)
add_4 = round_3 + code_block_31.gap

# group (continued): GF이상 레벨 거더 커브 필터링
contains_4 = List.Contains(list=add_4, item=flatten_8@L1)
filterByBoolMask_5 = List.FilterByBoolMask(list=빔거더용_라인_형성, mask=contains_4)

n5_경간_내_빔_개수 = StringInput("2")  # "5. 경간 내 빔 개수"; graph input
toNumber_5 = String.ToNumber(string=n5_경간_내_빔_개수)
segment_개수 = CodeBlock(i=toNumber_5) { i+1; }
code_block_32 = CodeBlock(segment_개수=segment_개수) { segment_개수; }
findCrvPtsAtEqSegLengthInHoriGirderCrv = Python(IN[0]=filterByBoolMask_5.in, IN[1]=code_block_32)  # CPython3
# ---------- findCrvPtsAtEqSegLengthInHoriGirderCrv.python (96 lines) ----------
# Load the Python Standard and DesignScript Libraries
import sys
import clr
clr.AddReference('ProtoGeometry')
from Autodesk.DesignScript.Geometry import *

################Module For Functional Programing#########################
from functools import reduce; from itertools import chain
from itertools import groupby; import operator
from copy import deepcopy
curry = lambda f: lambda a,*args: f(a, *args) if (len(args)) else lambda *args: f(a, *args)

filter, map, reduce = curry(filter), curry(map), curry(reduce)

go = lambda *args: reduce(lambda a,f: f(a), args) ## 함수도 축약 가능 ##

def dictUpdate(dic1,dic2):
    dic1.update(dic2)
    return dic1
    
def dictsMerge(dics):
    res = reduce(dictUpdate, dics)
    return res
    
def dictDeleteKeys(dic, keys):
    for k in keys:
        del dic[k]
    return dic

def flat(a):
    if isinstance(a, list):
        for i in a: 
            yield from flat(i)
    else: yield a

def grpBy(iter, key):
    f,keys,grps = key,[],[]
    sorted_ = sorted(iter, key=f)
    for key, grp_data in groupby(sorted_,key=f):
        keys.append(key); grps.append(list(grp_data))
    return grps,keys
#########################################################################
# The inputs to this node will be stored as a list in the IN variables.
dataEnteringNode = IN
girderCrvsPerLevel = IN[0]
segmentCnt = IN[1]
# Place your code below this line

## lvGrp -> dirGrp -> rowGrp -> eachLine
def find_XdirGirderCrvsPerLevel(girderCrvsPerLevel):
    res = []
    newLvGrp= []
    for lvGrp in girderCrvsPerLevel:
        for dirGrp in lvGrp:
            if dirGrp[0][0].Direction.Normalized().X==1:
                newLvGrp.append(dirGrp)
        res.append(newLvGrp)
    return res

def findBeamPts_inRowGrp(rowGrp):
    return list(map(lambda eachLine: eachLine.PointsAtEqualSegmentLength(segmentCnt), rowGrp))
    
def findBeamPts_inDirGrp(dirGrp):
    return list(map(findBeamPts_inRowGrp, dirGrp))
    
def findBeamPts_inLvGrp(lvGrp):
    return list(map(findBeamPts_inDirGrp, lvGrp))
    
def findBeamPts_all(ptsPerLevel):
    return list(map(findBeamPts_inLvGrp, ptsPerLevel))[0]

def matchRowGrpAndCreateBeamCrvs(dirGrp_pts):
    dirGrp_pts = list(dirGrp_pts)
    res = []
    maxIdx = len(list(dirGrp_pts))-1
    for idx in list(range(maxIdx)):
        rowGrp = dirGrp_pts[idx]
        nextRowGrp = dirGrp_pts[idx+1]
#        res.append(rowGrp)
        for sttGrp,endGrp in list(zip(rowGrp,nextRowGrp)):
            for i in range(len(list(sttGrp))):
                #res.append(sttGrp)
                try:
                    stt = list(sttGrp)[i]
                    end = list(endGrp)[i]
                    line_ = Line.ByStartPointEndPoint(stt, end)
                    res.append(line_)
                except: pass
    return res

XdirGirderCrvsPerLevel = list(find_XdirGirderCrvsPerLevel(girderCrvsPerLevel))
XdirBeamPtsPerLevel = findBeamPts_all(XdirGirderCrvsPerLevel)
allBeamLines = map(matchRowGrpAndCreateBeamCrvs, XdirBeamPtsPerLevel)
#res = matchRowGrpAndCreateBeamCrvs(XdirBeamPtsPerLevel[0])
# Assign your output to the OUT variable.
OUT = allBeamLines
# ----------------------------------------
code_block_33 = CodeBlock(allBeamsLine=findCrvPtsAtEqSegLengthInHoriGirderCrv) { allBeamsLine; }
startPoint_4 = Curve.StartPoint(curve=findCrvPtsAtEqSegLengthInHoriGirderCrv)
Z_6 = Point.Z(point=startPoint_4)
# note: 장축 커브 필터링
uniqueItems_6 = List.UniqueItems(list=Z_6@L2)
flatten_9 = List.Flatten(list=uniqueItems_6)
contains_5 = List.Contains(list=flatten_9, item=code_block_25.elevations@L1)
filterByBoolMask_6 = List.FilterByBoolMask(list=code_block_25.allLevels, mask=contains_5)

# group: 빔 생성
n8_빔_타입 = StructuralFramingTypes("H_SB_AR_S02_H-194x150x6x9_Platform")  # "8. 빔 타입"; frozen
beamByCurve_2 = StructuralFraming.BeamByCurve(curve=code_block_33, level=filterByBoolMask_6.in, structuralFramingType=n8_빔_타입)  # frozen

code_block_34 = CodeBlock { "z Offset Value"; 0; }
setParameterByName_2 = Element.SetParameterByName(element=beamByCurve_2, parameterName=code_block_34.out0, value=code_block_34.out1)
code_block_35 = CodeBlock { 500; }
byCenterPointRadius = Circle.ByCenterPointRadius(centerPoint=sublists, radius=code_block_35)
categories_2 = Categories("OST_GridHeads")
all_elements_of_category_2 = ElementsOfCategory(Category=categories_2)

# group: 그리드 격자 형성
firstItem_2 = List.FirstItem(list=byCoordinates)
firstItem_3 = List.FirstItem(list=firstItem_2@L2)
lastItem_4 = List.LastItem(list=firstItem_2@L2)
byStartPointEndPoint_3 = Line.ByStartPointEndPoint(startPoint=firstItem_3, endPoint=lastItem_4)
transpose_2 = List.Transpose(lists=firstItem_2)
firstItem_4 = List.FirstItem(list=transpose_2@L2)
lastItem_5 = List.LastItem(list=transpose_2@L2)
byStartPointEndPoint_4 = Line.ByStartPointEndPoint(startPoint=firstItem_4, endPoint=lastItem_5)
list_create_2 = List.Create(item0=byStartPointEndPoint_3, item1=byStartPointEndPoint_4)
code_block_36 = CodeBlock { 3000; }
extendEnd = Curve.ExtendEnd(curve=list_create_2, distance=code_block_36)
extendStart = Curve.ExtendStart(curve=extendEnd, distance=code_block_36)
byLine = Grid.ByLine(line=extendStart)  # frozen

# group: 그리드 이름 수정
flatten_10 = List.Flatten(list=byLine)
code_block_37 = CodeBlock { "Name"; }
make_GridName = Python(IN[0]=byLine)  # CPython3
# ---------- make_GridName.python (69 lines) ----------
# Load the Python Standard and DesignScript Libraries
import sys
import clr
clr.AddReference('ProtoGeometry')
from Autodesk.DesignScript.Geometry import *
################Module For Functional Programing#########################
from functools import reduce; from itertools import chain
from itertools import groupby; import operator
from copy import deepcopy
curry = lambda f: lambda a,*args: f(a, *args) if (len(args)) else lambda *args: f(a, *args)

filter, map, reduce = curry(filter), curry(map), curry(reduce)

go = lambda *args: reduce(lambda a,f: f(a), args) ## 함수도 축약 가능 ##

def dictUpdate(dic1,dic2):
    dic1.update(dic2)
    return dic1
    
def dictsMerge(dics):
    res = reduce(dictUpdate, dics)
    return res
    
def dictDeleteKeys(dic, keys):
    for k in keys:
        del dic[k]
    return dic

def flat(a):
    if isinstance(a, list):
        for i in a: 
            yield from flat(i)
    else: yield a

def grpBy(iter, key):
    f,keys,grps = key,[],[]
    sorted_ = sorted(iter, key=f)
    for key, grp_data in groupby(sorted_,key=f):
        keys.append(key); grps.append(list(grp_data))
    return grps,keys
#########################################################################

# The inputs to this node will be stored as a list in the IN variables.
dataEnteringNode = IN
grids = IN[0]
verSpanGrids = grids[1]
horSpanGrids = grids[0]
# Place your code below this line
alpha = [chr(c) for c in range(ord('A'),ord('Z')+1)]

def get_horGridsName(grids, alpha):
    res = go(
        grids, len, 
        lambda x: range(1,x+1),
        map(lambda x: alpha[x-1]),
    )
    return res

def get_verGridsName(grids):
    res = go(
        grids, len, 
        lambda x: range(1,x+1),
        map(str),
        
    )
    return res

# Assign your output to the OUT variable.
OUT = get_horGridsName(horSpanGrids, alpha), get_verGridsName(verSpanGrids)
# ----------------------------------------
flatten_11 = List.Flatten(list=make_GridName)
setParameterByName_3 = Element.SetParameterByName(element=flatten_10@L1, parameterName=code_block_37, value=flatten_11@L1)

# group: 그리드 타입 수정
flatten_12 = List.Flatten(list=setParameterByName_3)
code_block_38 = CodeBlock { "Grid"; "HA-GRID_10 mm Bubble_Red"; }
그리드_타입_수정 = Python(IN[0]=flatten_12, IN[1]=code_block_38.out1)  # CPython3; frozen
# ---------- 그리드_타입_수정.python (19 lines) ----------
# Load the Python Standard and DesignScript Libraries
import sys
import clr
clr.AddReference('ProtoGeometry')
from Autodesk.DesignScript.Geometry import *

# The inputs to this node will be stored as a list in the IN variables.
dataEnteringNode = IN
grids = IN[0]
gridTypeName = IN[1]
# Place your code below this line
def modify_gridsType(grids):
    try:
        list(map(lambda x: x.SetParameterByName("Type", ElementType.ByName(gridTypeName)), grids ))
    except:
        pass
    return grids
# Assign your output to the OUT variable.
OUT = modify_gridsType(grids)
# ----------------------------------------
code_block_39 = CodeBlock { "Type"; }

code_block_40 = CodeBlock()
# ---------- code_block_40.designscript (2 lines) ----------
// 단 스팬 건물 생성시 루프 구배 주면 에러 발생
// 장 단변 역전되면(y방향 스팬을 더 많이 입력하면) 에러
# ----------------------------------------
byName = ElementType.ByName(name=code_block_38.out1)
setParameterByName_4 = Element.SetParameterByName(element=flatten_12, parameterName=code_block_39, value=byName)
join_2 = List.Join(list0=code_block_17, list1=code_block_27)
flatten_13 = List.Flatten(list=join_2)
length = Curve.Length(curve=flatten_13)
sum = Math.Sum(values=length)
total_pseudo_cost = Watch(sum)  # graph output
python_script = Python(IN[0]=sum)  # CPython3
# ---------- python_script.python (16 lines) ----------
# Load the Python Standard and DesignScript Libraries
import sys
import clr
clr.AddReference('ProtoGeometry')
from Autodesk.DesignScript.Geometry import *

# The inputs to this node will be stored as a list in the IN variables.
dataEnteringNode = IN
data = IN[0]
# Place your code below this line
try:
    res = data/10
except:
    res = 100000000000000
# Assign your output to the OUT variable.
OUT = res
# ----------------------------------------
