# Dynamo graph 공통(2)_Quantity Calculator_3.0.1_240401.dyn (Dynamo 2.16.1.2727)
# author: MK Jang
# Auto Calculating the Quantities of each Element As per the Family List

# group: All Data in Excel
family_list_경로_입력 = Filename("..\etc\물량산출테스트용\02_플랜트건축팀_BIM_팀 표준 Family List_Rev.3_2024.03.26_SLCB.xlsx")  # graph input
file_from_path = FileObject(path=family_list_경로_입력)
target_sheet_names = CodeBlock()
# ---------- target_sheet_names.designscript (18 lines) ----------
[
"WM-AR"
,"산출기준"
,"0.Room"
,"1.Floors"
,"2.Roofs"
,"3.Walls_Ext"
,"3.Walls_Int"
,"4.St_Fdn"
,"5.St_Col"
,"6.St_Framing"
,"7.Ceilings"
,"8.Doors"
,"9.Windows"
,"10.Stairs"
,"11.Railings"
,"12.Generic"
];
# ----------------------------------------
boolean = BoolSelector(true)
importExcel = Data.ImportExcel(file=file_from_path, sheetName=target_sheet_names, showExcel=boolean)

# group: Excel data dictionarization
lang_mode_영_한_select = BoolSelector(true)
excel_data_dictionarization = Python(IN[0]=lang_mode_영_한_select, IN[1]=importExcel, IN[2]=target_sheet_names)  # CPython3; frozen
# ---------- excel_data_dictionarization.python (215 lines) ----------
# Load the Python Standard and DesignScript Libraries
import sys
import clr
clr.AddReference('ProtoGeometry')
from Autodesk.DesignScript.Geometry import *

from functools import reduce
from functools import partial

# The inputs to this node will be stored as a list in the IN variables.
dataEnteringNode = IN
lang_mode = IN[0]
wholeDatas = IN[1]
db = wholeDatas[1:]
allCatSheetsNames = IN[2][2:]

paramSheet = db[0]
allCatSheets = db[1:]

#db
# Place your code below this line
def make_UnifiedDict(dictsList):
    dicts_AllInOne = {}
    for d in dictsList:
        dict_k_v = d.items()
        for k,v in dict_k_v:
            dicts_AllInOne[k] = v
    return dicts_AllInOne

def find_IsInStr(target, str):
    if target == None or str == None:
        pass
    else:
        res = target in str
        return res
def find_range_by_columnItem(db, col_idx, sep_rule):
    tdb = list(map(lambda x: x[col_idx], db))
    last_idx_tdb = len(tdb)-1
    tdb_enum = enumerate(tdb)
    res = list(filter(lambda x: find_IsInStr(sep_rule, x[1]), tdb_enum))
    endidxs_tmp= list(map(lambda x: x[0]-1,res))
    endidxs_tmp.pop(0)
    endidxs = endidxs_tmp + [last_idx_tdb]
    famTypeNames = list(map(lambda x: x[1],res))
    famTypeNamesIdxs = list(map(lambda x: x[0],res))
    rangeSttIdxs = list(map(lambda x: x[0]+1,res))
    rangeEndIdxs = endidxs
    result = dict(zip(famTypeNames, zip(famTypeNamesIdxs, zip(rangeSttIdxs,rangeEndIdxs))))
    return result
    
    
def find_headersAtSheet(sheet):
    headers_sheet = map(lambda x: [x[1].replace("\n",""),x[0]], filter(lambda x: x[1] != None, enumerate(sheet[1])))
    
    return dict(headers_sheet)

def find_rangesAtSheet(sheet, hdrs_withIdx, trgt_hdr, trgt_str):
    return find_range_by_columnItem(sheet, hdrs_withIdx[trgt_hdr], trgt_str)


def get_DataOnRangesAtParamSheet(sheet):
    
    hdrs_withIdx = find_headersAtSheet(sheet)
    rangesATSheet = find_rangesAtSheet(sheet, hdrs_withIdx, "Q'ty Cal Type Tag", "-")
    title_idx = map(lambda x: x[0], rangesATSheet.values())
    calcType_colDatas = list(map(lambda x: x[hdrs_withIdx["Q'ty Cal Type Tag"]], sheet))
    calcTypes = list(map(lambda x: calcType_colDatas[x], title_idx))
    rgs_v = list(map(lambda x: x[1], rangesATSheet.values()))
    rgs_k = list(map(lambda x: x, rangesATSheet.keys()))
    
    hdrs_v = list(hdrs_withIdx.values())
    hdrs_k = list(hdrs_withIdx.keys())
    eff_hdrs_v = hdrs_v[2:]
    eff_hdrs_k = hdrs_k[2:]
    
    datas_allCalType = list(map(lambda x: sheet[x[0]-1:x[1]], rgs_v))
    
    def setDict_OnEachCalType(data_calType):
        paramName_lang = "패밀리 매개변수(from Revit) 영문판" if lang_mode is True else "패밀리 매개변수(from Revit) 한글판"
        calcTypeName = data_calType[0][2]
        data_calType_noneless = list(filter(lambda x: x[hdrs_withIdx["항목"]] != None, data_calType))
#        ## WM row 별 header명 과 짝짓기
        data_withHdrsIdx = list(map(lambda y: list(map(lambda x: y[x], eff_hdrs_v)), data_calType_noneless))
        dict_ = list(map(lambda x: dict(zip(eff_hdrs_k, x)), data_withHdrsIdx))
        dicts_noneless = list(map(lambda y: dict(filter(lambda x: x[1]!=None, y.items())),dict_))
#        ## dict_Cal Type 입력처리
        targetColName = "Q'ty Cal Type Tag"
        dicts_finalNoneless = []
        for d in dicts_noneless:
            d["Q'ty Cal Type Tag"] = calcTypeName
            
            if "입력값" in d.keys():
                d["applyForCalc"] = d["입력값"]
                dicts_finalNoneless.append(d)
            elif paramName_lang in d.keys():
                d["applyForCalc"] = d[paramName_lang]
                dicts_finalNoneless.append(d)
            else:
                pass
        
        return {calcTypeName: dicts_finalNoneless}
        
    return map(setDict_OnEachCalType, datas_allCalType)
    


def get_SymValDict_PerCalcType(dic):
    def findDictPerCalcType(dicList):
            dic = {}
            for i in dicList:
                dic[i["산출수식 약자"]] = i["applyForCalc"]
            return dic
    
    ks_forDic = list(dic.keys())
    vs_forDic = list(map(findDictPerCalcType, dic.values()))
    res = dict(zip(ks_forDic, vs_forDic))
    return res


def get_DataOnRangesAtCatSheet(catSheet):
    hdrs_withIdx = find_headersAtSheet(catSheet)
    rangesATSheet = find_rangesAtSheet(catSheet, hdrs_withIdx, "Family Type Name", "H_")
    title_idx = map(lambda x: x[0], rangesATSheet.values())
    calcType_colDatas = list(map(lambda x: x[hdrs_withIdx["Q'ty Cal Type Tag"]], catSheet))
    calcTypes = list(map(lambda x: calcType_colDatas[x], title_idx))
    rgs_v = list(map(lambda x: x[1], rangesATSheet.values()))
    rgs_k = list(map(lambda x: x, rangesATSheet.keys()))
    
    hdrs_v = list(hdrs_withIdx.values())
    hdrs_k = list(hdrs_withIdx.keys())
    
    datas_allFamType = list(map(lambda x: list(zip(catSheet[x[0]-1:x[1]], range(x[0]-1,x[1]))), rgs_v))
    
    def setDict_OnEachFamType(data_famType):  ## 최종적으로 산출식 없는 것 걸러내기 추가해야 함
        titleData = list(data_famType).pop(0)[0]
        
        famTypeName = titleData[hdrs_withIdx["Family Type Name"]]
        calcTypeName = titleData[hdrs_withIdx["Q'ty Cal Type Tag"]]
        data_famType_noneless = list(filter(lambda x: x[0][5] != None, data_famType))
        ## WM row 별 header명 과 짝짓기
        data_withHdrsIdx = list(map(lambda y: [list(map(lambda x: y[0][x], hdrs_v)), y[1]], data_famType_noneless))
        hdrs_k.append("rIDX")
        dict_ = list(map(lambda x: dict(zip(hdrs_k, x[0]+[x[1]])), data_withHdrsIdx))
        dicts_noneless = list(map(lambda y: dict(filter(lambda x: x[1]!=None, y.items())),dict_))
        ## dict_gauge, 물량산출식 없는 항목 처리
        dicts_final = []
        needDefault_ColName = "Gauge Code"
        noneRemove_ColName = "Dynamo 물량산출식"
        for d in dicts_noneless:
            d["Family Type Name"] = famTypeName
            
            if calcTypeName == None:
                pass            
            elif noneRemove_ColName in d.keys():
                d["Q'ty Cal Type Tag"] = calcTypeName
                d[needDefault_ColName] = ""
                dicts_final.append(d)

        return dicts_final
        
    dicts_allFamType = list(map(lambda x: setDict_OnEachFamType(list(x)), datas_allFamType))
    ds_famTypesAtCatSheet = dict(zip(rgs_k, dicts_allFamType))
    ds_famTypesAtCatSheet_effCalcType = dict(filter(lambda x: all(list(map(lambda i: "Q'ty Cal Type Tag" in i, x[1]))), list(ds_famTypesAtCatSheet.items())))
    ds_famTypesAtCatSheet_noneless = dict(filter(lambda x: len(list(x[1]))!=0, list(ds_famTypesAtCatSheet_effCalcType.items())))
    
    return  ds_famTypesAtCatSheet_noneless

def make_AIOdic(allCatSheets):

    dataOnRanges_allCat = list(map(get_DataOnRangesAtCatSheet, allCatSheets))
    dataOnRanges_allCat_WithCatNames = list(zip(allCatSheetsNames, dataOnRanges_allCat))
    
    AIOdic = {}
    for d in dataOnRanges_allCat_WithCatNames:
        catName = d[0]
        dict_k_v = d[1].items()
        for k,v in dict_k_v:
            for wm in v:
                wm["SheetName"] = catName
            AIOdic[k] = v
    return AIOdic



def matchWith_paramDic(catSheetDic, paramSheetDic):
    headers = list(catSheetDic.values())[0][0].keys()
    wmspec_headers = list(filter(lambda x: "Work C" in x or "Spec" in x, headers))
    res = {}
    for famType,diclist in catSheetDic.items():
        new_diclist = []
        for d in diclist:
            new_d = {}
            keys = d.keys()
            keys_new = set(keys) - set(wmspec_headers)
            calcType = d["Q'ty Cal Type Tag"]
            new_d["Sym_Val Dict"] = paramSheetDic[calcType]
            new_d["wmSpecs"] = list(map(lambda x: d[x],wmspec_headers))
            for spec in keys_new:
                new_d[spec] = d[spec]
            new_diclist.append(new_d)
        
        res[famType] = new_diclist
        
    return res

calcTypeDictsList = get_DataOnRangesAtParamSheet(paramSheet)
calcTypeDict = make_UnifiedDict(calcTypeDictsList)
paramSheetDic = get_SymValDict_PerCalcType(calcTypeDict) 

catSheetDic = make_AIOdic(allCatSheets)
catFam_paramDic = matchWith_paramDic(catSheetDic, paramSheetDic)

# Assign your output to the OUT variable.

OUT = [catFam_paramDic,paramSheetDic, catSheetDic]
# ----------------------------------------
elemDicts = CodeBlock(i=excel_data_dictionarization) { i[0]; }
famTypeDic = CodeBlock(i=excel_data_dictionarization) { i[2]; }
paramSheetDic = CodeBlock(i=excel_data_dictionarization) { i[1]; }

# group: All Elements in Revit
categories = Categories("OST_Rooms")
all_elements_of_category = ElementsOfCategory(Category=categories)
all_elementsexceptrails = Python()  # CPython3; unwired: IN[0]
# ---------- all_elementsexceptrails.python (51 lines) ----------
# Load the Python Standard and DesignScript Libraries
import sys
import clr
clr.AddReference('ProtoGeometry')
from Autodesk.DesignScript.Geometry import *

clr.AddReference('RevitAPI')
from Autodesk.Revit.DB import *
import Autodesk

clr.AddReference('RevitServices')
import RevitServices
from RevitServices.Persistence import DocumentManager
doc = DocumentManager.Instance.CurrentDBDocument

def get_all_BIC():

    db = [
    Autodesk.Revit.DB.BuiltInCategory.OST_Floors,
    Autodesk.Revit.DB.BuiltInCategory.OST_Roofs,
    Autodesk.Revit.DB.BuiltInCategory.OST_Walls,
    Autodesk.Revit.DB.BuiltInCategory.OST_StructuralFoundation,
    Autodesk.Revit.DB.BuiltInCategory.OST_StructuralColumns,
    Autodesk.Revit.DB.BuiltInCategory.OST_StructuralFraming,
    Autodesk.Revit.DB.BuiltInCategory.OST_Ceilings,
    Autodesk.Revit.DB.BuiltInCategory.OST_Doors,
    Autodesk.Revit.DB.BuiltInCategory.OST_Windows,
    Autodesk.Revit.DB.BuiltInCategory.OST_Stairs,
    #Autodesk.Revit.DB.BuiltInCategory.OST_Railings,
    ]
    return db
    
def get_allElems(doc):
    bics = get_all_BIC()
    
    def getElems(x):
        collector = FilteredElementCollector(doc)
        res = collector.OfCategory(x).WhereElementIsNotElementType().ToElements()
        return res

    def getRailElems(x):
        collector = FilteredElementCollector(doc)
        res = collector.OfCategory(x).WhereElementIsNotElementType()
        return res

    res = map(getElems, bics)
#    res = getRailElems(Autodesk.Revit.DB.BuiltInCategory.OST_RailingSystemRail)
    return res


OUT = get_allElems(doc)
# ----------------------------------------
categories_2 = Categories("OST_StairsRailing")
all_elements_of_category_2 = ElementsOfCategory(Category=categories_2)
list_create = List.Create(item0=all_elements_of_category_2)
join = List.Join(list0=all_elements_of_category, list1=all_elementsexceptrails, list2=list_create)

lang_mode_영_한_select_2 = BoolSelector(true)
excel_data_dictionarization_3_0 = Python(IN[0]=lang_mode_영_한_select_2, IN[1]=importExcel, IN[2]=target_sheet_names)  # "Excel data dictionarization_3.0.1_new"; CPython3
# ---------- excel_data_dictionarization_3_0.python (461 lines) ----------
# Load the Python Standard and DesignScript Libraries"
import sys
import clr
clr.AddReference('ProtoGeometry')
from Autodesk.DesignScript.Geometry import *

################Module For Functional Programing##########################
from functools import reduce
from itertools import chain
from itertools import groupby
from copy import deepcopy
curry = lambda f: lambda a,*args: f(a, *args) if (len(args)) else lambda *args: f(a, *args)

filter = curry(filter)
map = curry(map)
reduce = curry(reduce)

go = lambda *args: reduce(lambda a,f: f(a), args) ## 함수도 축약 가능 ##

def dictUpdate(dic1,dic2):
    res = dic1.update(dic2)
    #res = {**dic1,**dic2}
    return dic1 #res
    
def dictsMerge(dics):
    res = reduce(dictUpdate, dics)
    return res
    
def dictDeleteKeys(dic, keys):
    for k in keys:
        del dic[k]
    return dic
##########################################################################

import re
from functools import partial

# The inputs to this node will be stored as a list in the IN variables.
dataEnteringNode = IN
lang_mode = IN[0]
wholeDatas = IN[1]
db = wholeDatas[1:]
allCatSheetsNames = IN[2][2:]

calcStdSheet = db[0] ##산출기준 시트
allCatSheets = db[1:]

#wmspec_headers = [
#    "Work Master Code" ,"GaugeCode" ,"Unit" ,"Work Category-L1"
#    ,"Work Category-L2" ,"Work Category-L3" ,"Spec. 1- L4" ,"Spec. 2- L5"
#    ,"Spec. 3- L6" ,"Spec. 4- L7" ,"Spec. 5- L8" ,"Spec. 6- L9"
#    ,"Spec. 7- L10" ,"Spec. 8- L11" ,"BOQ Spec1" ,"BOQ Spec2" ,"BOQ Spec3"
#    ,"BOQ Spec4" ,"BOQ Spec5" ,"BOQ Spec6" ,"BOQ Spec7" ,"BOQ Spec8" ,"BOQ Spec9"
#    ,"Description" ,"입찰_물량산출식" ,"실행_물량산출식" ,"rIDX"
#]
# Place your code below this line

def find_IsInStr(target, string):
    if target == None or string == None:
        pass
    else:
        res = str(target) in str(string)
        return res

def find_range_by_columnItem(db, col_idx, sep_rule):
    tdb = list(map(lambda x: x[col_idx], db)) ##targetTransposedDB (col_idx에 해당하는 데이터만 추출)
    last_idx_tdb = len(tdb)-1
    tdb_enum = enumerate(tdb)
    target_RowNumber = list(filter(lambda x: find_IsInStr(sep_rule, x[1]), tdb_enum))
    endidxs_tmp= list(map(lambda x: x[0]-1,target_RowNumber))
    endidxs_tmp.pop(0)
    endidxs = endidxs_tmp + [last_idx_tdb] ## 각 구간별 마지막 행 번호
    rangeSttIdxs = list(map(lambda x: x[0]+1,target_RowNumber))
    rangeEndIdxs = endidxs
    result = list(zip(rangeSttIdxs, rangeEndIdxs))
    return result

    
def find_headersAtSheet(sheet):
    headers_sheet = list(map(lambda x: [x[1].replace("\n",""),x[0]], filter(lambda x: x[1] != None, enumerate(sheet[1]))))
    
    return dict(headers_sheet)
    #return list(headers_sheet)

def find_rangesAtSheet(sheet, hdrs_withIdxDict, trgt_hdr, trgt_str):
    #hdrs_withIdxDict = dict(hdrs_withIdx)
    return find_range_by_columnItem(sheet, hdrs_withIdxDict[trgt_hdr], trgt_str)


def get_DataOnGrpsAtSheet(sheet:list, discrHDRStr, discrRowStr):
    """
    판별기준 Header문자열(discrHDRStr)이 들어있는 열에서,
    판별기준 행 문자열(discrRowStr)이 들어있는 행번호 기준으로 구역을 나누어 데이터 리스트 반환
    """
    hdrs_withIdxDict = find_headersAtSheet(sheet)

    # 시트별 그룹 구분 (시작 행번호, 끝 행 번호 추출)
    rowAreasAtSheet = find_rangesAtSheet(sheet, hdrs_withIdxDict, discrHDRStr, discrRowStr)
    
    # 시트 각행에 rIDX 데이터 주입하는 구간 - (시작) >>>>>>>
    ## 헤더의 칼럼 인덱스 중 가장 큰 것 추출
    hdrs_maxCol_idx = max(list(hdrs_withIdxDict.values()))
    ## 마지막 헤더보더 한칸 옆을 행인덱스번호("rIDX") 정보 보관 위치로 설정
    hdrs_withIdxDict["rIDX"] = hdrs_maxCol_idx+1
    ## 시트의 각 행을 번호와 함께 pair 형태로 추출
    sheetWith_rIDX = list(enumerate(sheet))
    ## rIDX 보관된 시트 데이터 저장을 위한 빈 리스트 선언
    sheet_rIDX = []
    ## pair 형태의 각 행에서, 마지막 헤더의 한칸 우측위치에 rIDX 데이터 주입
    ## 시트의 각 행마다 x 라는 이름으로 순회하며,
    for x in sheetWith_rIDX:
        ### 행의 전체 데이터 길이가 마지막 헤더 위치보다 클때,
        if len(x)<hdrs_maxCol_idx:
            #### 마지막 헤더의 우측 칸 위치를 rIDX 데이터로 치환
            x[1][hdrs_maxCol_idx+1] = x[0]
            sheet_rIDX.append(x[1])
            
        ### 행의 전체 데이터 길이가 마지막 헤더 위치와 같을때,
        else:
            #### 마지막 헤더의 우측칸이 없으므로 append로 rIDX 데이터 추가
            x[1].append(x[0])
            sheet_rIDX.append(x[1])
    # <<<<< 시트 각행에 rIDX 데이터 주입하는 구간 - (끝)
    
    rowsGrps_perType_withNone = list(map(lambda x: sheet_rIDX[x[0]-1:x[1]], rowAreasAtSheet))
    # None 데이터 치환 구간
    rowsListGrps_perType = go(#>
        rowsGrps_perType_withNone, list,
        ## 하나의 타입을 규정하는 행들의 모임에서
        map(lambda rowGrp: \
        ## 한 행씩 골라서
        list(map(lambda row: \
        ## 행을 구성하는 셀 값 중 None이 있으면 빈문자열로 치환
        list(map(lambda cell: "" if cell==None else cell, row)), rowGrp)) ),
        ## 맵 객체가 반환되므로 리스트 변환
        list,
    )#<
    
    return (rowsListGrps_perType, hdrs_withIdxDict)

def cvt_rowsListGrps_toDictGrps(rowsListGrps_perType, hdrs_withIdxDict):
    """
    헤더 행과 다수의 컨텐츠 행으로 이루어진 rowListGrps를,
    모든 행을 헤더와 결합된 딕셔너리화 해서 rowDictGrps를 만드는 함수
    """
    eff_hdrs_idx = hdrs_withIdxDict.values()
    eff_hdrs_name = hdrs_withIdxDict.keys()
    
    rowsDictGrps_perType = go(#>
        rowsListGrps_perType,
        ## 하나의 타입을 규정하는 행들의 모임에서 한 행 씩 조작하는 함수들을 구상 후
        ## 맵 함수 내에서 go로 합성하여 반복시켜 사용
        map(lambda rowGrp: go(#>>
            ### 그룹 전체 가져와서
            rowGrp,
            ### 각 행을 리스트 타입으로 변환
            map(list), list,
            ### 헤더에 해당하는 행 값을 추출--
            map(lambda row: list(map(lambda idx: row[idx], eff_hdrs_idx))), list,
            ### 헤더이름과 행 내부의 값을 2개씩 짝지어 줌
            map(lambda row: list(zip(eff_hdrs_name, row))), list,
            ### 헤더이름 : 값의 형태로 각 행 데이터를 딕셔너리로 만듬
            map(lambda x: dict(x)), list,
            )#<<
        ), list,
    )#<
    return rowsDictGrps_perType

# 행딕셔너리 별 입력한 규칙에 따라 참거짓 여부를 반환하는 함수
def findRow_AppliedType(rowDict, tgtHDRname, rule=None):
    p = re.compile('[0-9]{3,5}')
    target = str(rowDict[tgtHDRname])
    ## 함수 호출시 구분자(rule) 없이 호출한 경우
    ## -Room Category 시트 용 이며 "Standard Type" 항목의 값이 000형태의 숫자인지를 판별
    ## -Room Category 중 "Standard Type" 칼럼에 룸 넘버, "Family Type Name" 칼럼에 룸 이름 입력하게 되어있음
    if rule==None:
        p = re.compile('[0-9]{3,5}')
        m = p.match(target)
        stdCase = target =="Room No"
        res = all([m or stdCase])
    ## 구분자(rule)가 정규표현식 객체로 들어온 경우
    elif isinstance(rule, re.Pattern):
        m = p.match(target)
        res = all([m])
    ## 구분자(rule)가 문자열로 들어온 경우
    else:
        res = rule in target
    return res



def form_TypeDict(rowsDictGrps,titleKeyName,sttIdx):
    """
    rowsDictGrps_perType을 받아서 각 그룹의 이름을 키로 하는
    새로운 중첩구조의 Dictionary를 만들어서,
    바깥에서 타입이름으로 딕셔너리에 접근하면 
    바로 해당 구성내용을 반환해주는 데이터 구조를 만드는 함수
    """
    typeDict = go(#>
        rowsDictGrps, list,
        filter(lambda x: x!=[]),
        map(lambda rowsDictGrp: \
            ### 그룹 전체 첫행 중 타이틀키값과 나머지 row 들 dict를 짝지어 새로운 딕셔너리로 형성
            [list(rowsDictGrp)[0][titleKeyName],go(#>>
                list(rowsDictGrp)[sttIdx:],
                #### 모두 빈칸인 값일때 제외 필터링
                filter(lambda row: any(list(map(lambda cell: cell!="", list(row.values()))))),
                list,
            )]#<<
        ),list,
        dict,
    )#<
    
    return typeDict

def updateDict_symValPair(calcTypeDict):
    allCalcTypeNames = list(calcTypeDict.keys())
    res = {}
    for x in allCalcTypeNames:
        type = {}
        for rD in calcTypeDict[x]:
            if rD["수동 입력값"]!="" and rD["산출수식 약자"]!="":
                rD["applyForCalc"] = rD["수동 입력값"]
                type[rD["산출수식 약자"]]=rD["applyForCalc"]
            elif rD["Parameter"]!="" and rD["산출수식 약자"]!="":
                rD["applyForCalc"] = rD["Parameter"]
                type[rD["산출수식 약자"]]=rD["applyForCalc"]
        res[x] = type
    return res
   

def find_stdWMdicts_inGrp(rowsDictGrp):
    res = go(
        rowsDictGrp, list,
        ## 엑셀 "물량산출식", "Work Master Code" 열에 값이 없는 행 제외
        filter(lambda rD: rD["입찰_물량산출식"] != "" and rD["실행_물량산출식"] != ""),
        filter(lambda rD: rD["Work Master Code"] != ""),
        ## Family Type Name에 "H_" 문자열 포함된 경우 제외
        filter(lambda rD: not findRow_AppliedType(rD, "Family Type Name", rule="H_")),
        ## 행 딕셔너리의 NO, Standard Type 업데이트
        map(lambda rD: dictUpdate(rD,{"NO":rowsDictGrp[0]["NO"], "Standard Type":rowsDictGrp[0]["Standard Type"]})),
        ## Q'ty Cal Type Tag 업데이트
        map(lambda rD: dictUpdate(rD,{"Q'ty Cal Type Tag":rowsDictGrp[0]["Q'ty Cal Type Tag"]})),
        list,
    )
    return res


def find_stdWMdicts_forCat(rowsDictsGrps):
    res = go(#>
        rowsDictsGrps, list,
        map(find_stdWMdicts_inGrp),
        #filter(lambda x: x!=[]),
        list,
    )#<
    return res

def find_appliedTypeDicts_forCat(rowsDictsGrps):
    eff_hdrs_name = list(rowsDictsGrps[0][0].keys())
    wmspec_headers = ["Work Master Code", "GaugeCode", "Unit"]\
        + list(filter(lambda x: "Work Cat" in x or "Spec" in x, eff_hdrs_name))\
        + ["Description","입찰_물량산출식", "실행_물량산출식", "rIDX"]
    #stdWMsDicts = find_stdWMdicts_forCat(rowsDictGrps)
    
    appliedTypeDicts = go(#>
        rowsDictsGrps,
        map(lambda rowsDictsGrp: go(#>>
            rowsDictsGrp, list,
            ## Family Type Name에 "H_" 문자열 포함된 경우만 필터링
            filter(lambda rD: findRow_AppliedType(rD, "Family Type Name", rule="H_")),
            ## 행 딕셔너리의 NO, Standard Type 업데이트 - 추후 함수 분리 염두
            map(lambda rD: dictUpdate(rD,{"NO":rowsDictsGrp[0]["NO"], "Standard Type":rowsDictsGrp[0]["Standard Type"]})),
            ## 그룹 첫행을 기준으로 Q'ty Cal Type Tag 업데이트 - 추후 함수 분리 염두
            map(lambda rD: dictUpdate(rD,{"Q'ty Cal Type Tag":rowsDictsGrp[0]["Q'ty Cal Type Tag"]})),
            
            # wmSpecs 속성들을 헤더로 하는 새로운 딕셔너리 형성 및 값 추가(값은 list형태)
            map(lambda rD: dictUpdate(rD, {"wmSpecs": go(
                ### wmspec관련 항목들 값을 리스트로 모음
                map(lambda x: rD[x], wmspec_headers), list,
                ### 항목명과 항목값을 모아서 딕셔너리 형태로 변환
                lambda x: zip(wmspec_headers,x), dict,
                ### wmSpecs 항목을 리스트 구조로 수정해 두기
                lambda x: [x] if x["Work Master Code"]!="" else [],
                
            )}) ),
            ## 밖으로 꺼내진 WorkMaster 관련 속성 삭제
            map(lambda rD: dictDeleteKeys(rD, wmspec_headers)), list,
            list,
            )#<<
        ),
        # 실적용 패밀리타입이 없는 그룹은 제외하는 구간
        filter(lambda x: list(x)!=[]),
        list,
    )#<
    
    return appliedTypeDicts

def find_appliedTypeDicts_forRoom(rowsDictsGrps):
    eff_hdrs_name = list(rowsDictsGrps[0][0].keys())
    wmspec_headers = ["Work Master Code", "GaugeCode", "Unit"]\
        + list(filter(lambda x: "Work Cat" in x or "Spec" in x, eff_hdrs_name))\
        + ["Description","입찰_물량산출식", "실행_물량산출식", "rIDX"]
    
    appliedTypeDicts = go(#>
        rowsDictsGrps,
        map(lambda rowsDictsGrp: go(#>>
            rowsDictsGrp, list,
            ## Standard Type 에 "H_" 문자열 포함된 경우만 필터링(only for room)
            filter(lambda rD: findRow_AppliedType(rD, "Standard Type")),
            ## 행 딕셔너리의 NO, Standard Type 업데이트 - 추후 함수 분리 염두
            map(lambda rD: dictUpdate(rD,{"NO":rD["Standard Type"], "Standard Type":rowsDictsGrp[0]["Standard Type"]})),
            ## 그룹 첫행을 기준으로 Q'ty Cal Type Tag 업데이트 - 추후 함수 분리 염두
            map(lambda rD: dictUpdate(rD,{"Q'ty Cal Type Tag":rowsDictsGrp[0]["Q'ty Cal Type Tag"]})),
            
            # wmSpecs 속성들을 헤더로 하는 새로운 딕셔너리 형성 및 값 추가(값은 list형태)
            map(lambda rD: dictUpdate(rD, {"wmSpecs": go(
                ### wmspec관련 항목들 값을 리스트로 모음
                map(lambda x: rD[x], wmspec_headers), list,
                ### 항목명과 항목값을 모아서 딕셔너리 형태로 변환
                lambda x: zip(wmspec_headers,x), dict,
                ### wmSpecs 항목을 리스트 구조로 수정해 두기
                lambda x: [x] if x["Work Master Code"]!="" else [],
                
            )}) ),
            ## 밖으로 꺼내진 WorkMaster 관련 속성 삭제
            map(lambda rD: dictDeleteKeys(rD, wmspec_headers)), list,
            
            ## Room 의 경우는 "No"와 "Family Type Name"을 합쳐서 "Family Type Name"에 입력
            map(lambda rD: dictUpdate(rD,{"Family Type Name":str(rD["NO"]).split('.')[0]+"_"+rD["Family Type Name"]})),
            
            list,
            )#<<
        ),
        # 실적용 패밀리타입이 없는 그룹은 제외하는 구간
        filter(lambda x: list(x)!=[]),
        list,
    )#<
    
    return appliedTypeDicts

def merge_sameFamType_wmSpecs(appliedTypeDicts):
    def merge_inGrp(appliedTypeDicts_perGrp):
        """
        엑셀 타입별 행그룹 내에서 실 적용 패일리명이 들어있는
        행들만 추출하고, 그 중 이름이 같은 것들의 wm 정보는 합쳐서
        하나의 이름에 하나의 딕셔너리 객체만 존재하도록 수정
        """
        ## 그룹 내 실 적용 패밀리 타입 명 추출(중복 불허)
        keysPerGrp = go(#>
            appliedTypeDicts_perGrp,
            ## 개별 행딕셔너리의 패밀리 타입 항목 값 추출
            map(lambda rD: rD["Family Type Name"]),
            ## 문자열 내 "H_"가 포함되어있는 지 검사
            filter(lambda x: "H_" in x),
            ## 중복 Family Type Name 단일화
            set, list,
        )#<
        ## 패밀리 타입 명을 k라는 변수명으로 하나씩 순회
        for k in keysPerGrp:
            ### k라는 패밀리 타입 명에 해당하는 딕셔너리 모두 검색
            sameNameDicts = list(filter(lambda x: x["Family Type Name"] == k, appliedTypeDicts_perGrp))
            ### 하나의 타입명에 복수 객체인지를 검사하여
            ### 2개 이상인 경우
            if len(sameNameDicts)>=2:
                ### 동일 이름의 딕셔너리들 중 첫번째 항목의 "wmSpecs"에
                ### 나머지 항목의 wmSpecs 항목을 몰아준다
                for i,rD in enumerate(sameNameDicts[1:]):
                    sameNameDicts[0]["wmSpecs"].append(*rD["wmSpecs"])
                ### 몰아주기가 끝나면, 첫번째를 제외한 나머지 딕셔너리는
                ### 불필요해지므로 삭제
                appliedTypeDicts_perGrp.remove(sameNameDicts[i+1])
            else:                
                pass
        ## 수정된 딕셔너리들 리스트를 반환
        return appliedTypeDicts_perGrp
    # 단위 그룹에 대한 함수를 복수 그룹들 전체에 시행
    return map(merge_inGrp, appliedTypeDicts)



def inject_stdWMtoAppliedTypeDicts(appliedTypeDicts, allCat_stdWMdicts_stdTypeName):
    def inject_inGrp(appliedTypeDict_perGrp):
        """
        타입 그룹 별 공통 WM 딕셔너리 항목들을
        실적용패밀리 딕셔너리에 주입하는 함수
        """
        ## 실적용패밀리 딕셔너리 리스트의 구성 원소 각각을
        ## rD(rowDictionary) 라는 이름으로 순회
        for rD in appliedTypeDict_perGrp:
            ### rD의 "Standard Type" 항목 값이
            ### 입력받은 타입별 공통 WM항목 딕셔너리의 키값중에
            ### 포함되었는지 검사후 있으면,
            if rD["Standard Type"] in list(allCat_stdWMdicts_stdTypeName.keys()):
                #### rD의 "wmSpecs" 항목에 공통 WM항목을 추가하여 재할당
                rD["wmSpecs"] = rD["wmSpecs"] + allCat_stdWMdicts_stdTypeName[rD["Standard Type"]]
            else:
                pass
        ## 수정된 딕셔너리들 리스트를 반환
        return appliedTypeDict_perGrp
    # 단위 그룹에 대한 함수를 복수 그룹들 전체에 시행
    return list(map(inject_inGrp, appliedTypeDicts))
    
def updateFamTypeDicts_symValPair(total_appliedTypeDicts, calcTypeDict_symValPair):
    """
    실적용패밀리타입명 별 딕셔너리에
    "Q'ty Cal Type Tag" 항목 값 이름과 일치하는
    물량산출 매개변수 꾸러미 추가하는 함수
    """
    # 전체 결과물 담을 빈 딕셔너리 선언
    res = {}
    # 전체 실적용 패밀리 딕셔너리들 중 구성원소 각각을 d라는 이름으로 순회
    for d in total_appliedTypeDicts:
        ## 딕셔너리의 "Q'ty Cal Type Tag"항목의 값이 빈문자열이 아니라면,
        if d["Q'ty Cal Type Tag"]!="":
            ### 딕셔너리에 "Sym_Val Dict"라는 키를 추가하고
            ### calcTypeDict 중 일치하는 값을 골라 키의 값으로 할당
            symValPair = calcTypeDict_symValPair[d["Q'ty Cal Type Tag"]]
            d["Sym_Val Dict"] = symValPair
        ## 전체용 빈 딕셔너리에 패밀리 타입명을 키로 추가하고
        ## 방금 수정한 단위 딕셔너리를 키의 값으로 할당
        res[d["Family Type Name"]] = d    
    return res
    
    
    
    
calcSheet_rowsListGrps_perType = get_DataOnGrpsAtSheet(calcStdSheet, "구간판별", "#")
calcSheet_rowsDictGrps_perType = cvt_rowsListGrps_toDictGrps(*calcSheet_rowsListGrps_perType)
calcTypeDict = form_TypeDict(calcSheet_rowsDictGrps_perType,"Q'ty Cal Type Tag",sttIdx=1)
calcTypeDict_symValPair = updateDict_symValPair(calcTypeDict)

roomSheet_rowsListGrps_perType = get_DataOnGrpsAtSheet(allCatSheets[0], "Standard Type", "H_")
roomSheet_rowsDictGrps_perType = cvt_rowsListGrps_toDictGrps(*roomSheet_rowsListGrps_perType)
room_stdWMdicts = find_stdWMdicts_forCat(deepcopy(roomSheet_rowsDictGrps_perType))
room_stdWMdicts_stdTypeName = form_TypeDict(room_stdWMdicts, "Standard Type",sttIdx=0)

room_appliedTypeDicts = find_appliedTypeDicts_forRoom(roomSheet_rowsDictGrps_perType)
room_appliedTypeDicts_noDupl = merge_sameFamType_wmSpecs(room_appliedTypeDicts)

room_appliedTypeDicts_withStdWm = list(chain(*inject_stdWMtoAppliedTypeDicts(room_appliedTypeDicts_noDupl, room_stdWMdicts_stdTypeName)))

# 룸 제외 모든 카테고리 시트 처리
allCatSheet_rowsListGrps = map( lambda x: get_DataOnGrpsAtSheet(x, "Standard Type", "H_"), allCatSheets[1:] )
allCatSheet_rowsDictGrps = map( lambda x: cvt_rowsListGrps_toDictGrps(*x), allCatSheet_rowsListGrps )

# "Standard Type" 별 wm 공통항목 찾기
allCat_stdWMdicts = list(map( lambda x: find_stdWMdicts_forCat(x), deepcopy(allCatSheet_rowsDictGrps) ))
# "Standard Type" 명으로 검색할 수 있는, 전 카테고리 "Standard Type" 별 공통 WM항목 사전 만들기
allCat_stdWMdicts_stdTypeName = dictsMerge(list(map(lambda x: form_TypeDict(x, "Standard Type",sttIdx=0), allCat_stdWMdicts)))

allCat_appliedTypeDicts = map( lambda x: find_appliedTypeDicts_forCat(x), allCatSheet_rowsDictGrps )
allCat_appliedTypeDicts_noDupl = map( lambda x: merge_sameFamType_wmSpecs(x), allCat_appliedTypeDicts )

allCat_appliedTypeDicts_withStdWm = list(chain(*chain(*map( lambda x: inject_stdWMtoAppliedTypeDicts(x,allCat_stdWMdicts_stdTypeName), allCat_appliedTypeDicts_noDupl ))))

total_appliedTypeDicts = room_appliedTypeDicts_withStdWm + allCat_appliedTypeDicts_withStdWm
FamTypeDicts_symValPair = updateFamTypeDicts_symValPair(total_appliedTypeDicts,calcTypeDict_symValPair)

# Assign your output to the OUT variable.

OUT = FamTypeDicts_symValPair
# ----------------------------------------

# group: 필터링 구간 (패밀리 리스트에 없는 이름 제외)
flatten = List.Flatten(list=join)
type = Object.Type(object=flatten)
code_block = CodeBlock(i=type) { i=="Revit.Elements.Room"; }
filterByBoolMask = List.FilterByBoolMask(list=flatten, mask=code_block)
code_block_2 = CodeBlock { "Type"; "Type Name"; }
getParameterValueByName = Element.GetParameterValueByName(element=filterByBoolMask.out, parameterName=code_block_2.out0)
keys = DesignScript.Builtin.Dictionary.Keys(dictionary=excel_data_dictionarization_3_0)
code_block_3 = CodeBlock { "_"; }
code_block_4 = CodeBlock { "Number"; "Name"; }
getParameterValueByName_2 = Element.GetParameterValueByName(element=filterByBoolMask.in, parameterName=code_block_4.out0)
getParameterValueByName_3 = Element.GetParameterValueByName(element=filterByBoolMask.in, parameterName=code_block_4.out1)
list_create_2 = List.Create(item0=getParameterValueByName_2, item1=getParameterValueByName_3)
transpose = List.Transpose(lists=list_create_2)
join_2 = String.Join(separator=code_block_3, string0=transpose)
code_block_5 = CodeBlock(i=join_2) { i[0]; }
getParameterValueByName_4 = Element.GetParameterValueByName(element=getParameterValueByName, parameterName=code_block_2.out1)
join_3 = List.Join(list0=code_block_5, list1=getParameterValueByName_4)
contains = List.Contains(list=keys, item=join_3@L1)
filterByBoolMask_2 = List.FilterByBoolMask(list=flatten, mask=contains)
code_block_6 = CodeBlock(filtered=filterByBoolMask_2.in) { filtered; }

# group: Family Type 별 WM 코드 Revit 되먹임
# note: Revit에 있는 Family Type 항목만
filterByBoolMask_3 = List.FilterByBoolMask(list=getParameterValueByName, mask=contains)  # frozen
uniqueItems = List.UniqueItems(list=filterByBoolMask_3.in)
code_block_7 = CodeBlock(catSheetDatas=elemDicts, UniqElemTypes=uniqueItems) { catSheetDatas; UniqElemTypes; }
code_block_8 = CodeBlock { "Type"; "Type Name"; }
getParameterValueByName_5 = Element.GetParameterValueByName(element=code_block_7.UniqElemTypes, parameterName=code_block_8.out1)
valueAtKey = DesignScript.Builtin.Dictionary.ValueAtKey(dictionary=code_block_7.catSheetDatas, key=getParameterValueByName_5)
byKeysValues = DesignScript.Builtin.Dictionary.ByKeysValues(keys=getParameterValueByName_5, values=valueAtKey)
code_block_9 = CodeBlock { "Q'ty Cal Type Tag"; }
get_WMCodesAndBriefSpec = Python(IN[0]=byKeysValues, IN[1]=code_block_9)  # CPython3
# ---------- get_WMCodesAndBriefSpec.python (33 lines) ----------
# Load the Python Standard and DesignScript Libraries
import sys
import clr
clr.AddReference('ProtoGeometry')
from Autodesk.DesignScript.Geometry import *

# The inputs to this node will be stored as a list in the IN variables.
dataEnteringNode = IN
dict_aio = IN[0]
calType_header = IN[1]
# Place your code below this line
famTypes = list(dict_aio.items())
res_dict = {}


def find_WMspecsPerFamType(k_v):
    k = k_v[0]
    wms = k_v[1]
    res = list(map(lambda x: [x["Work Master Code"]] + x["wmSpecs"], wms))
    res_zeroless = list(map(lambda y: filter(lambda x: x!=0, y), res))
    joined_strs = list(map(lambda x: ' | '.join(x),res_zeroless))

    return k,joined_strs

WMspecs = list(map(find_WMspecsPerFamType, famTypes))

for k,v in WMspecs:
    res_dict[k] = [dict_aio[k][0][calType_header]] + v



# Assign your output to the OUT variable.
OUT = res_dict
# ----------------------------------------
valueAtKey_2 = DesignScript.Builtin.Dictionary.ValueAtKey(dictionary=get_WMCodesAndBriefSpec, key=getParameterValueByName_5)
code_block_10 = CodeBlock()
# ---------- code_block_10.designscript (12 lines) ----------
[
"H_Q'ty Cal Type Tag",
"H_WM Code_1",
"H_WM Code_2",
"H_WM Code_3",
"H_WM Code_4",
"H_WM Code_5",
"H_WM Code_6",
"H_WM Code_7",
"H_WM Code_8",
"H_WM Code_9"
];
# ----------------------------------------
setParamElementTypes = Python(IN[0]=code_block_7.UniqElemTypes, IN[1]=valueAtKey_2, IN[2]=code_block_10)  # CPython3; frozen
# ---------- setParamElementTypes.python (36 lines) ----------
# Load the Python Standard and DesignScript Libraries
import sys
import clr
clr.AddReference('ProtoGeometry')
from Autodesk.DesignScript.Geometry import *

clr.AddReference("RevitNodes")
import Revit
from Revit.Elements import *

# The inputs to this node will be stored as a list in the IN variables.
dataEnteringNode = IN
elemTypes = IN[0]
WMs_perFamTyp = IN[1]
param_ListForWM = IN[2]

input_sets = list(zip(elemTypes, WMs_perFamTyp))

# Place your code below this line

def setParamAnElem(elem, paramNames, paramVals):
    effName_List = paramNames[:len(paramVals)]
    effVals_List = paramVals
    setForParam = list(zip(effName_List, effVals_List))
    res = list(map(lambda x: elem.SetParameterByName(x[0],x[1]), setForParam))
    
    return res


final = map(lambda x: setParamAnElem(x[0],param_ListForWM,x[1]), input_sets)


#res = elemT.GetParameterValueByName("Default Thickness")
# Assign your output to the OUT variable.
#OUT = input_sets
OUT = final
# ----------------------------------------

code_block_11 = CodeBlock(file_path=family_list_경로_입력) { file_path; }
code_block_12 = CodeBlock(file_path=code_block_11) { file_path; }

# group: Family List엑셀파일 물량 기입 구간
code_block_13 = CodeBlock(file_path=code_block_12) { file_path; }
components = DesignScript.Builtin.Dictionary.Components()  # unwired: dictionary
code_block_14 = CodeBlock { 6; 31; }
code_block_15 = CodeBlock { 1; }
getItemAtIndex = List.GetItemAtIndex(list=components.values@@L2, index=code_block_15)
dropItems = List.DropItems(list=getItemAtIndex@L2, amount=code_block_14.out0)
exportToExcel = Data.ExportToExcel(filePath=code_block_13, sheetName=components.keys@L1, startRow=code_block_14.out0, startColumn=code_block_14.out1, data=dropItems@L2)  # frozen

firstItem = List.FirstItem(list=importExcel)
code_block_16 = CodeBlock(wm_sheetDatas=firstItem) { wm_sheetDatas; }
code_block_17 = CodeBlock(wm_sheetDatas=code_block_16) { wm_sheetDatas; }

# group: [WM-AR] 시트 데이터 정리
code_block_18 = CodeBlock(wm_sheetDatas=code_block_17) { wm_sheetDatas; }
code_block_19 = CodeBlock { 3+8; }
getItemAtIndex_2 = List.GetItemAtIndex(list=code_block_18@L2, index=code_block_19)
code_block_20 = CodeBlock { 6; }
dropItems_2 = List.DropItems(list=getItemAtIndex_2, amount=code_block_20)
uniqueItems_2 = List.UniqueItems(list=dropItems_2)
code_block_21 = CodeBlock(description판별항목1=uniqueItems_2) { description판별항목1; }
code_block_22 = CodeBlock { 5+8; }
getItemAtIndex_3 = List.GetItemAtIndex(list=code_block_18@L2, index=code_block_22)
code_block_23 = CodeBlock { 6; }
dropItems_3 = List.DropItems(list=getItemAtIndex_3, amount=code_block_23)
uniqueItems_3 = List.UniqueItems(list=dropItems_3)
code_block_24 = CodeBlock(description판별항목2=uniqueItems_3) { description판별항목2; }

code_block_25 = CodeBlock(famTypeDic=famTypeDic) { famTypeDic; }

# group: Total BOQ 엑셀파일 물량 기입 구간
total_boq_sheet_경로_입력 = Filename(".\Total BOQ_blank.xlsx")  # graph input
code_block_26 = CodeBlock { "(AR) BOQ"; "(AR) BOQ View (Working)"; false; }
code_block_27 = CodeBlock(filePath=total_boq_sheet_경로_입력, sheetName=code_block_26.out1) { filePath; sheetName; }
건물명_입력 = StringInput("Please enter Building Name before running ")  # graph input
list_create_3 = List.Create(item0=code_block_21, item1=code_block_24)
file_from_path_2 = FileObject(path=total_boq_sheet_경로_입력)
# note: Work Master Code
# Gauge Code
# Description : (L03)
# Spec. : (L04~L11)
# Additional Spec : (Description 항목 값)
importExcel_2 = Data.ImportExcel(file=file_from_path_2, sheetName=code_block_26.out1, showExcel=code_block_26.out2)  # frozen
total_boq_데이터_파싱__ar_boq시트 = Python(IN[0]=건물명_입력, IN[1]=list_create_3, IN[2]=importExcel_2)  # CPython3
# ---------- total_boq_데이터_파싱__ar_boq시트.python (162 lines) ----------
# Load the Python Standard and DesignScript Libraries
import sys
import clr
clr.AddReference('ProtoGeometry')
from Autodesk.DesignScript.Geometry import *

from functools import reduce
from functools import partial
from string import ascii_lowercase
import itertools
from itertools import chain
import re
    
#################################Module For Functional Programing#############################################
curry = lambda f: lambda a,*args: f(a, *args) if (len(args)) else lambda *args: f(a, *args)

filter = curry(filter)
map = curry(map)

def _take(length, iter):
    res = []
    for a in iter:
        res.append(a)
        if len(res) == length:
            return res
        
take = curry(_take)
reduce = curry(reduce)

go = lambda *args: reduce(lambda a,f: f(a), args) ## 함수도 축약 가능 ##
##############################################################################################################
def find_IsInStr(target, str):
    if target == None or str == None:
        pass
    else:
        res = target in str
        return res
        
def find_IsInList(List, str):
    if str == None or List == None:
        pass
    else:
        res = str in List
        return res

def find_range_by_columnItem(db, col_idx, sep_rule):
    tdb = list(map(lambda x: x[col_idx], db))
    last_idx_tdb = len(tdb)-1
    tdb_enum = enumerate(tdb)
    res = list(filter(lambda x: find_IsInStr(sep_rule, x[1]), tdb_enum))
    endidxs_tmp= list(map(lambda x: x[0]-1,res))
    #endidxs_tmp= list(map(lambda x: x[0],res))
    endidxs_tmp.pop(0)
    endidxs = endidxs_tmp + [last_idx_tdb]
    famTypeNames = list(map(lambda x: x[1],res))
    famTypeNamesIdxs = list(map(lambda x: x[0],res))
    rangeSttIdxs = list(map(lambda x: x[0]+1,res))
    rangeEndIdxs = endidxs
    result = dict(zip(famTypeNames, zip(famTypeNamesIdxs, zip(rangeSttIdxs,rangeEndIdxs))))
    return result
    
def find_range_by_columnItem_discrim(db, col_idx, 판별항목):
    tdb = list(map(lambda x: x[col_idx], db))
    last_idx_tdb = len(tdb)-1
    tdb_enum = enumerate(tdb)
    res = list(filter(lambda x: find_IsInList(판별항목, x[1]), tdb_enum))
    endidxs_tmp= list(map(lambda x: x[0]-1,res))
    #endidxs_tmp= list(map(lambda x: x[0],res))
    endidxs_tmp.pop(0)
    endidxs = endidxs_tmp + [last_idx_tdb]
    famTypeNames = list(map(lambda x: x[1],res))
    famTypeNamesIdxs = list(map(lambda x: x[0],res))
    rangeSttIdxs = list(map(lambda x: x[0]+1,res))
    rangeEndIdxs = endidxs
    result = dict(zip(famTypeNames, zip(famTypeNamesIdxs, zip(rangeSttIdxs,rangeEndIdxs))))
    return result

# The inputs to this node will be stored as a list in the IN variables.
dataEnteringNode = IN
bd_name = IN[0]
descr판별항목 = IN[1]
판별항목lv1 = descr판별항목[0]
판별항목lv2 = descr판별항목[1]
db = IN[2]


# Place your code below this line
def Is_newSheet(Sheet):
    
    hdrs_withIdx = dict(list(find_headersAtSheet(Sheet).items()) + list(find_headers_Building(Sheet, bd_name).items()))
    datasOnWMCodeCol = list(map(lambda x: x[hdrs_withIdx["Work Master Code"]], Sheet))
    
    p = re.compile('\w{8}-\w{5}')
    IsNewSheet = not(any(list(map(lambda x: p.match(str(x)), datasOnWMCodeCol))))
    
    
    return [IsNewSheet,datasOnWMCodeCol]
    
def find_headersAtSheet(Sheet):
    headers_Sheet = map(lambda x: [x[1].replace("\n",""),x[0]], filter(lambda x: x[1] != None, enumerate(Sheet[2])))
    res = dict(headers_Sheet)
    #del res["_"]
    
    return res
    
def find_headers_Building(Sheet, bd_name):
    headers_bd = map(lambda x: [x[1].replace("\n",""),x[0]], filter(lambda x: x[1] != None, enumerate(Sheet[3])))
    headers_targetBD = list(filter(lambda x: x[0] == bd_name, headers_bd))
    res = {}
    res["targetBD"] = headers_targetBD[0][1]
    return res

def find_rangesAtSheet(Sheet, hdrs_withIdx, 판별항목):
    return find_range_by_columnItem_discrim(Sheet, hdrs_withIdx["Description"], 판별항목)

def get_DataOnRangesAtSheet(Sheet):
    
    hdrs_withIdx = dict(list(find_headersAtSheet(Sheet).items()) + list(find_headers_Building(Sheet, bd_name).items()))
    rgs_v_lv1 = list(map(lambda x: x[1], find_rangesAtSheet(Sheet, hdrs_withIdx, 판별항목lv1).values()))
    rgs_v_lv2 = list(map(lambda x: x[1], find_rangesAtSheet(Sheet, hdrs_withIdx, 판별항목lv2).values()))
    
    idxs_v_lv1 = list(map(lambda x: range(x[0],x[1]+1), rgs_v_lv1))

    datas_lv1 = []
    col_datas = list(map(lambda x: x[hdrs_withIdx["Description"]], Sheet))
    for rg in idxs_v_lv1:
        lv1_str = col_datas[rg[0]-1]
        tmp = []
        for i in rg:
            tmp.append([i, lv1_str, col_datas[i]])
        
        datas_lv1.append(tmp)

    datas_lv2 = []
    for rg in datas_lv1:
        tmp = []
        for idx,v in enumerate(rg):
            if v[2] == None:
                tmp.append([v[0],v[1],tmp[idx-1][2]])
            else:
                tmp.append(v)
        datas_lv2.append(tmp)

    flatten_res = list(chain(*datas_lv2))
    rres = itertools.groupby(flatten_res, lambda x: [x[1], x[2]])
    
    res = {}
    for k, g in rres:
        #print(list(g))
        removedfirstelem_g = list(g)[1:]
        res["_".join(k)] = [removedfirstelem_g[0][0],removedfirstelem_g[-1][0]]
        #res["_".join(k)] = removedfirstelem_g
    
    return res


hdrs_withIdx = dict(list(find_headersAtSheet(db).items()) + list(find_headers_Building(db, bd_name).items()))

if Is_newSheet(db)[0]:
    OUT = hdrs_withIdx, [Is_newSheet(db)[0],get_DataOnRangesAtSheet(db)]
else:
    OUT = hdrs_withIdx, Is_newSheet(db)
# ----------------------------------------
code_block_28 = CodeBlock(i=total_boq_데이터_파싱__ar_boq시트)
# ---------- code_block_28.designscript (3 lines) ----------
i[0];
i[1];
//구간 rIdx;
# ----------------------------------------
total_boq복사_및_경로_반환 = Python(IN[0]=code_block_27.filePath, IN[1]=code_block_28.out1)  # CPython3; frozen
# ---------- total_boq복사_및_경로_반환.python (35 lines) ----------
# Load the Python Standard and DesignScript Libraries
import sys
import clr
clr.AddReference('ProtoGeometry')
from Autodesk.DesignScript.Geometry import *
import datetime
import shutil

# The inputs to this node will be stored as a list in the IN variables.
dataEnteringNode = IN
origin_pathStr = IN[0]
IsNewSheet = IN[1][0]
# Place your code below this line

def copy_fromNewSheet():
    now = datetime.datetime.now()
    strList = origin_pathStr.split('.')
    
    add_str = now.strftime("%m%d-%I%M%S")
    add_res = "".join(["_",add_str,"."])
    strList.insert(1, add_res)
    res = "".join(strList)
    
    source = origin_pathStr
    destination = res
    shutil.copyfile(source, destination)
    
    return res

# Assign your output to the OUT variable.

if IsNewSheet:
    OUT = copy_fromNewSheet()
else:
    OUT = origin_pathStr
# ----------------------------------------
code_block_29 = CodeBlock { dict_groupBy_Sheet_WM; }  # unwired: dict_groupBy_Sheet_WM
wm별_계산결과_및_spec_정리_from_element = Python(IN[0]=code_block_29)  # CPython3
# ---------- wm별_계산결과_및_spec_정리_from_element.python (69 lines) ----------
# Load the Python Standard and DesignScript Libraries
import sys
import clr
clr.AddReference('ProtoGeometry')
from Autodesk.DesignScript.Geometry import *

import operator
from itertools import groupby
import copy

# The inputs to this node will be stored as a list in the IN variables.
dataEnteringNode = IN
elemDicts = IN[0]
# Place your code below this line
def extractCalcResult(elemDicts):
    res = []
    for d in elemDicts:
        wms = d["wms"]
        for wm in wms:
            keys = ["SheetName", "rIDX", "Work Master Code", "Gauge Code", "wmSpecs", "Family Type Name", "calcResult"]
            vals = list(map(lambda x: wm[x],keys))
            k_v = list(zip(keys, vals))
            res_d = dict(k_v)
            if "Description" in wm.Keys:
                res_d["Description"] = wm["Description"]
            else:
                res_d["Description"] = ""
            res_d["wmcANDgauge"] = "".join([wm["Work Master Code"],wm["Gauge Code"]])
            res_d["UoM"] = wm["Unit"]
            res.append(res_d)
        
    return res

def make_dict_groupBy_WM(elemDicts):
    extractedDicts = extractCalcResult(elemDicts)
    sortedDicts_WMC = sorted(extractedDicts, key=operator.itemgetter("wmcANDgauge"))
    grpDicts_WMC = groupby(sortedDicts_WMC, key=operator.itemgetter("wmcANDgauge"))
    
    res = []
    for k, g in grpDicts_WMC: 
        wmCode = k
        gg = copy.deepcopy(list(g))
        calcSum = round(sum(map(lambda x: x["calcResult"], gg)),3)
        wmSpecs = gg[0]["wmSpecs"]
        catStr = "_".join([wmSpecs[0],wmSpecs[1]])
        specOnly = list(filter(lambda x: x!=0, wmSpecs))[3:]
        addSpec = gg[0]["Description"]
        dict_res = {
            "catStr": catStr,
            "Work Master Code": wmCode,
            "Gauge Code": gg[0]["Gauge Code"],
            "Description": wmSpecs[2],
            "Spec.": "\n".join(specOnly),
            "Additional Spec.": addSpec,
            "calcVal": calcSum,
            "UoM": gg[0]["UoM"]
            #"wmSpecs": wmSpecs,
            }
        res.append(dict_res)
    
    
    return res

extDicts = extractCalcResult(elemDicts)


# Assign your output to the OUT variable.
OUT = make_dict_groupBy_WM(elemDicts)
#OUT = sorted(set(map(lambda x: x["Work Master Code"], extDicts)))
# ----------------------------------------
wm별_spec_정리_from_family_list = Python(IN[0]=wm별_계산결과_및_spec_정리_from_element, IN[1]=code_block_25)  # CPython3
# ---------- wm별_spec_정리_from_family_list.python (136 lines) ----------
# Load the Python Standard and DesignScript Libraries
import sys
import clr
clr.AddReference('ProtoGeometry')
from Autodesk.DesignScript.Geometry import *

import operator
from itertools import groupby
from itertools import chain
import copy

# The inputs to this node will be stored as a list in the IN variables.
dataEnteringNode = IN
elemDicts = IN[0]
famTypeDict = IN[1]
wmDicts = list(chain(*famTypeDict.values()))
# Place your code below this line
def merge_dicts(*dict_args):
    """
    Given any number of dictionaries, shallow copy and merge into a new dict,
    precedence goes to key-value pairs in latter dictionaries.
    """
    result = {}
    for dictionary in dict_args:
        result.update(dictionary)
    return result

def getUnique_wmDicts(wmDicts):
    headers = wmDicts[0].Keys
    wmspec_headers = list(filter(lambda x: "Work C" in x or "Spec" in x, headers))
    noNeedKeys = ["Family Type Name", "Quantity", "rIDX", "Dynamo 물량산출식", "SheetName", "Q'ty Cal Type Tag"]
    def refineDicts(dicts, noNeedKeys):
        dicts_refined = []
        for d in dicts:
            new_d = {}
            keys,vals = d.Keys,d.Values
            keys_new = set(keys) - set(wmspec_headers)
            items = zip(keys, vals)  
            for k,v in items:
                if k not in noNeedKeys+wmspec_headers:
                    new_d[k] = v
                    new_d["wmSpecs"] = list(map(lambda x: d[x], wmspec_headers))
            dicts_refined.append(new_d)
        return dicts_refined
    wmDicts_refined = refineDicts(wmDicts, noNeedKeys)
        
    allWMcodes = list(map(lambda x: x["Work Master Code"], wmDicts_refined))
    uniqueWMcodes = set(allWMcodes)
    
    def getUnique(dicts, tgt_key):
        res = []
        tmp = []
        for d in dicts:
            if d[tgt_key] not in tmp:
                tmp.append(d[tgt_key])
                res.append(d)
        return res
    
    unique_wmDicts = getUnique(wmDicts_refined, "Work Master Code")

        
    return unique_wmDicts
    

    
def reformatDicts(wmDicts):
    res = []

    for wm in wmDicts:
        keys = ["Work Master Code", "Gauge Code", "wmSpecs"]
        vals = list(map(lambda x: wm[x],keys))
        items = list(zip(keys, vals))
        res_d = dict(items)
        
        if "Description" in wm.keys():
            res_d["Description"] = wm["Description"]
        else:
            res_d["Description"] = ""
        res_d["wmcANDgauge"] = "".join([wm["Work Master Code"],wm["Gauge Code"]])
        res_d["UoM"] = wm["Unit"]
        res.append(res_d)
        
    return res

def make_dict_groupBy_WM(wmDicts, elemDicts):
    unique_wmDicts = getUnique_wmDicts(wmDicts)
    reformated_dicts = reformatDicts(unique_wmDicts)
    sortedDicts_WMC = sorted(reformated_dicts, key=operator.itemgetter("wmcANDgauge"))
    grpDicts_WMC = groupby(sortedDicts_WMC, key=operator.itemgetter("wmcANDgauge"))
    
    wm_valDicts = {}
    for x in elemDicts:
        wm_valDicts[x["Work Master Code"]] = x["calcVal"]
    
    
    res = []
    for k, g in grpDicts_WMC: 
        wmCode = k
        gg = copy.deepcopy(list(g))
        wmSpecs = gg[0]["wmSpecs"]
        catStr = "_".join([wmSpecs[0],wmSpecs[1]])
        specOnly = list(filter(lambda x: x!=0, wmSpecs))[3:]
        addSpec = gg[0]["Description"]
        if wm_valDicts.get(k):
            dict_res = {
                "catStr": catStr,
                "Work Master Code": wmCode,
                "Gauge Code": gg[0]["Gauge Code"],
                "Description": wmSpecs[2],
                "Spec.": "\n".join(specOnly),
                "Additional Spec.": addSpec,
                "calcVal": wm_valDicts[k],
                "UoM": gg[0]["UoM"]
                #"wmSpecs": wmSpecs,
                }
        else:
            dict_res = {
                "catStr": catStr,
                "Work Master Code": wmCode,
                "Gauge Code": gg[0]["Gauge Code"],
                "Description": wmSpecs[2],
                "Spec.": "\n".join(specOnly),
                "Additional Spec.": addSpec,
                "calcVal": "",
                "UoM": gg[0]["UoM"]
                #"wmSpecs": wmSpecs,
                }
        res.append(dict_res)
    
    
    return res


# Assign your output to the OUT variable.
#OUT = make_dict_groupBy_WM(wmsList)
OUT = make_dict_groupBy_WM(wmDicts, elemDicts)
# ----------------------------------------
data_formatting_for_excel_export = Python(IN[0]=code_block_28.out1, IN[1]=wm별_spec_정리_from_family_list)  # CPython3
# ---------- data_formatting_for_excel_export.python (58 lines) ----------
# Load the Python Standard and DesignScript Libraries
import sys
import clr
clr.AddReference('ProtoGeometry')
from Autodesk.DesignScript.Geometry import *

from itertools import groupby
from itertools import chain

# The inputs to this node will be stored as a list in the IN variables.
dataEnteringNode = IN

IsNewSheet = IN[0][0]
inputDatas = IN[0][1]
wmsDicts = IN[1]
# Place your code below this line

def get_wmsGrped_sorted_idxed(rangeDicts, wmsDicts):
    wmsSorted = sorted(wmsDicts, key=lambda x: x["Work Master Code"])
    wmsGrped = groupby(wmsDicts, lambda x: x["catStr"])
    wmsGrped_sorted = []
    
    for k,v in wmsGrped:
        grp_sorted = sorted(list(v), key=lambda x: x["Work Master Code"])
        stt_idx = rangeDicts[k][0]
        length_grp = len(grp_sorted)
        idxs = range(stt_idx, stt_idx+length_grp)
        zip_grp_idxs = list(zip(idxs, grp_sorted))
        for i in zip_grp_idxs:
            d = i[1]
            d["rIDX"] = i[0]
        
        wmsGrped_sorted.append(grp_sorted)
        
    wmsGrped_sorted_idxed = list(chain(*wmsGrped_sorted))
    return wmsGrped_sorted_idxed

def match_DictWithIdx(datasOnWMCodeCol, wmsDicts):
    new_wmsDicts = []
    idxWithDatasOnWMCode = enumerate(datasOnWMCodeCol)
    for d in wmsDicts:
        if d["Work Master Code"] in datasOnWMCodeCol:
            d["rIDX"] = datasOnWMCodeCol.index(d["Work Master Code"])
            new_wmsDicts.append(d)
        else:
            pass
    #res = new_wmsDicts
    return new_wmsDicts

# Assign your output to the OUT variable.
if IsNewSheet:
    rangeDicts = inputDatas
    res = get_wmsGrped_sorted_idxed(rangeDicts, wmsDicts)
else:
    datasOnWMCodeCol = inputDatas
    res = filter(lambda x: x["calcVal"] != "", match_DictWithIdx(datasOnWMCodeCol, wmsDicts))

OUT = res
# ----------------------------------------
export_to_total_boq = Python(IN[0]=total_boq복사_및_경로_반환, IN[1]=code_block_27.sheetName, IN[2]=code_block_28.out0, IN[3]=code_block_28.out1, IN[4]=data_formatting_for_excel_export)  # CPython3; graph output; frozen
# ---------- export_to_total_boq.python (111 lines) ----------
# Load the Python Standard and DesignScript Libraries
import sys
import clr
clr.AddReference('ProtoGeometry')
from Autodesk.DesignScript.Geometry import *

from itertools import groupby

import DSOffice

# The inputs to this node will be stored as a list in the IN variables.
dataEnteringNode = IN
filePath = IN[0]
sheetName = IN[1]
hdrs_withIdx = IN[2]
IsNewSheet = IN[3][0]
dictList = IN[4]

# Place your code below this line
exportToExcel = DSOffice.Data.ExportToExcel
#print(hdrs_withIdx)

hdrsColIdxs = [
        hdrs_withIdx["Work Master Code"],
        hdrs_withIdx["Gauge Code"],
        hdrs_withIdx["Description"],
        hdrs_withIdx["Spec."],
        hdrs_withIdx["Additional Spec."],
        hdrs_withIdx["Reference to"],
        hdrs_withIdx["UoM"],
        hdrs_withIdx["targetBD"],
            ]

def writeToNewSheet(dictList):
    dictList_grped = groupby(dictList, lambda x: x["catStr"])
    
    dictList_grpedList = []
    for k,grp in dictList_grped:
        dictList_grpedList.append(list(grp))
    
    def writeExcel(keys, startColhdr, grpedList):
        for i in dictList_grpedList:
            #keys = ["Work Master Code", "Gauge Code", "Description", "Spec.", "Additional Spec.", ]
            startCol = hdrs_withIdx[startColhdr]
            startRow = i[0]["rIDX"]
    
            datas = list(zip(*map(lambda y: map(lambda x: x.get(y), list(i)), keys)))
            #res.append(datas)
            exportToExcel(filePath, sheetName, startRow, startCol, datas)
    
    #keys1 = ["Work Master Code", "Gauge Code", "Description", "Spec.", "Additional Spec.", ]
    keys1 = ["Work Master Code", "Gauge Code", "Description", "Spec.", "Additional Spec.", "Reference to", "UoM"]
    #keys2 = ["UoM"]
    keys3 = ["calcVal"]
    
    writeExcel(keys1,"Work Master Code", dictList_grpedList)
    #writeExcel(keys2,"UoM", dictList_grpedList)
    writeExcel(keys3,"targetBD", dictList_grpedList)
    
    return dictList_grpedList
    
def writeToExistSheet(dictList):
    dictList_grped = groupby(dictList, lambda x: x["catStr"])
    
    dictList_grpedList = []
    for k,grp in dictList_grped:
        dictList_grpedList.append(list(grp))
    
    def writeExcel_(keys,startColhdr, grpedList):
        #res = []
        for i in dictList_grpedList:
            #keys = ["Work Master Code", "Gauge Code", "Description", "Spec.", "Additional Spec.", ]
            startCol = hdrs_withIdx[startColhdr]
            startRow = i[0]["rIDX"]
    
            datas = list(zip(*map(lambda y: map(lambda x: x[y], list(i)), keys)))
            #res.append(datas)
            exportToExcel(filePath, sheetName, startRow, startCol, datas)
        #return res
        
    def writeExcel(key,startColhdr, dictList):
        all_rIDXs = list(map(lambda x: x["rIDX"], dictList))
        min_rIDX = min(all_rIDXs)
        max_rIDX = max(all_rIDXs)
        all_ranges = range(min_rIDX, max_rIDX+1)
        
        startCol = hdrs_withIdx[startColhdr]
        startRow = min_rIDX
        datas = []
        for i in all_ranges:
            if i in all_rIDXs:
                datas.append([dictList[all_rIDXs.index(i)][key]])
            else:
                datas.append([""])
        
        exportToExcel(filePath, sheetName, startRow, startCol, datas)
        
        #return datas
        
    key = "calcVal"
    
        
    writeExcel(key,"targetBD", dictList)
    
    return dictList_grpedList
# Assign your output to the OUT variable.

if IsNewSheet:
    OUT = writeToNewSheet(dictList)
else:
    OUT = writeToExistSheet(dictList)
# ----------------------------------------
code_block_30 = CodeBlock { "Steam Turbine Building"; "Gate House"; }

code_block_31 = CodeBlock()  # //레빗 프로젝트 단위 중 길이가 m 여야 한다
file_path = Filename("..\etc\_팀교육\프로그래밍 교육\dict_room.json")
stringifyJSON = Data.StringifyJSON()  # unwired: values
writeText = FileSystem.WriteText(filePath=file_path, text=stringifyJSON)  # frozen
excel_data_dictionarization_3_0_2 = Python(IN[0]=lang_mode_영_한_select_2, IN[1]=importExcel, IN[2]=target_sheet_names)  # "Excel data dictionarization_3.0.1"; CPython3; frozen
# ---------- excel_data_dictionarization_3_0_2.python (439 lines) ----------
# Load the Python Standard and DesignScript Libraries"
import sys
import clr
clr.AddReference('ProtoGeometry')
from Autodesk.DesignScript.Geometry import *

################Module For Functional Programing##########################
from functools import reduce
from itertools import chain
from itertools import groupby
from copy import deepcopy
curry = lambda f: lambda a,*args: f(a, *args) if (len(args)) else lambda *args: f(a, *args)

filter = curry(filter)
map = curry(map)
reduce = curry(reduce)

go = lambda *args: reduce(lambda a,f: f(a), args) ## 함수도 축약 가능 ##

def dictUpdate(dic1,dic2):
    res = dic1.update(dic2)
    #res = {**dic1,**dic2}
    return dic1 #res
    
def dictsMerge(dics):
    res = reduce(dictUpdate, dics)
    return res
    
def dictDeleteKeys(dic, keys):
    for k in keys:
        del dic[k]
    return dic
##########################################################################

import re
from functools import partial

# The inputs to this node will be stored as a list in the IN variables.
dataEnteringNode = IN
lang_mode = IN[0]
wholeDatas = IN[1]
db = wholeDatas[1:]
allCatSheetsNames = IN[2][2:]

calcStdSheet = db[0] ##산출기준 시트
allCatSheets = db[1:]

#wmspec_headers = [
#    "Work Master Code" ,"GaugeCode" ,"Unit" ,"Work Category-L1"
#    ,"Work Category-L2" ,"Work Category-L3" ,"Spec. 1- L4" ,"Spec. 2- L5"
#    ,"Spec. 3- L6" ,"Spec. 4- L7" ,"Spec. 5- L8" ,"Spec. 6- L9"
#    ,"Spec. 7- L10" ,"Spec. 8- L11" ,"BOQ Spec1" ,"BOQ Spec2" ,"BOQ Spec3"
#    ,"BOQ Spec4" ,"BOQ Spec5" ,"BOQ Spec6" ,"BOQ Spec7" ,"BOQ Spec8" ,"BOQ Spec9"
#    ,"Description" ,"입찰_물량산출식" ,"실행_물량산출식"
#]
# Place your code below this line

def find_IsInStr(target, string):
    if target == None or string == None:
        pass
    else:
        res = str(target) in str(string)
        return res

def find_range_by_columnItem(db, col_idx, sep_rule):
    tdb = list(map(lambda x: x[col_idx], db)) ##targetTransposedDB (col_idx에 해당하는 데이터만 추출)
    last_idx_tdb = len(tdb)-1
    tdb_enum = enumerate(tdb)
    target_RowNumber = list(filter(lambda x: find_IsInStr(sep_rule, x[1]), tdb_enum))
    endidxs_tmp= list(map(lambda x: x[0]-1,target_RowNumber))
    endidxs_tmp.pop(0)
    endidxs = endidxs_tmp + [last_idx_tdb] ## 각 구간별 마지막 행 번호
    rangeSttIdxs = list(map(lambda x: x[0]+1,target_RowNumber))
    rangeEndIdxs = endidxs
    result = list(zip(rangeSttIdxs, rangeEndIdxs))
    return result

    
def find_headersAtSheet(sheet):
    headers_sheet = list(map(lambda x: [x[1].replace("\n",""),x[0]], filter(lambda x: x[1] != None, enumerate(sheet[1]))))
    
    return dict(headers_sheet)
    #return list(headers_sheet)

def find_rangesAtSheet(sheet, hdrs_withIdxDict, trgt_hdr, trgt_str):
    #hdrs_withIdxDict = dict(hdrs_withIdx)
    return find_range_by_columnItem(sheet, hdrs_withIdxDict[trgt_hdr], trgt_str)


def get_DataOnGrpsAtSheet(sheet:list, discrHDRStr, discrRowStr):
    """
    판별기준 Header문자열(discrHDRStr)이 들어있는 열에서,
    판별기준 행 문자열(discrRowStr)이 들어있는 행번호 기준으로 구역을 나누어 데이터 리스트 반환
    """
    hdrs_withIdxDict = find_headersAtSheet(sheet)
    rowAreasAtSheet = find_rangesAtSheet(sheet, hdrs_withIdxDict, discrHDRStr, discrRowStr)
    # 행 별 인덱스 추
#    rIDXs = list(map(lambda x: range(x[0]-1, x[1]+1), rowAreasAtSheet))
#    sheetWith_rIDX = list(zip(rIDXs, sheet))
#    sheet_rIDX = list(map(lambda x: x[1] + [x[0]],sheetWith_rIDX))
    
    rowsGrps_perType_withNone = list(map(lambda x: sheet[x[0]-1:x[1]], rowAreasAtSheet))
    # None 데이터 치환 구간
    rowsListGrps_perType = go(#>
        rowsGrps_perType_withNone, list,
        
        ## 하나의 타입을 규정하는 행들의 모임에서
        map(lambda rowGrp: \
        ## 한 행씩 골라서
        list(map(lambda row: \
        ## 행을 구성하는 셀 값 중 None이 있으면 빈문자열로 치환
        list(map(lambda cell: "" if cell==None else cell, row)), rowGrp)) ),
        ## 맵 객체가 반환되므로 리스트 변환
        list,
        ## 행별 rIDX 값 추가
        
    )#<
    
    return (rowsListGrps_perType, hdrs_withIdxDict)

def cvt_rowsListGrps_toDictGrps(rowsListGrps_perType, hdrs_withIdxDict):
    """
    헤더 행과 다수의 컨텐츠 행으로 이루어진 rowListGrps를,
    모든 행을 헤더와 결합된 딕셔너리화 해서 rowDictGrps를 만드는 함수
    """
    eff_hdrs_idx = hdrs_withIdxDict.values()
    eff_hdrs_name = hdrs_withIdxDict.keys()
    
    rowsDictGrps_perType = go(#>
        rowsListGrps_perType,
        ## 하나의 타입을 규정하는 행들의 모임에서 한 행 씩 조작하는 함수들을 구상 후
        ## 맵 함수 내에서 go로 합성하여 반복시켜 사용
        map(lambda rowGrp: go(#>>
            ### 그룹 전체 가져와서
            rowGrp,
            ### 각 행을 리스트 타입으로 변환
            map(list), list,
            ### 헤더에 해당하는 행 값을 추출--
            map(lambda row: list(map(lambda idx: row[idx], eff_hdrs_idx))), list,
            ### 헤더이름과 행 내부의 값을 2개씩 짝지어 줌
            map(lambda row: list(zip(eff_hdrs_name, row))), list,
            ### 헤더이름 : 값의 형태로 각 행 데이터를 딕셔너리로 만듬
            map(lambda x: dict(x)), list,
            )#<<
        ), list,
    )#<
    return rowsDictGrps_perType

# 행딕셔너리 별 입력한 규칙에 따라 참거짓 여부를 반환하는 함수
def findRow_AppliedType(rowDict, tgtHDRname, rule=None):
    p = re.compile('[0-9]{3,5}')
    target = str(rowDict[tgtHDRname])
    ## 함수 호출시 구분자(rule) 없이 호출한 경우
    ## -Room Category 시트 용 이며 "Standard Type" 항목의 값이 000형태의 숫자인지를 판별
    ## -Room Category 중 "Standard Type" 칼럼에 룸 넘버, "Family Type Name" 칼럼에 룸 이름 입력하게 되어있음
    if rule==None:
        p = re.compile('[0-9]{3,5}')
        m = p.match(target)
        stdCase = target =="Room No"
        res = all([m or stdCase])
    ## 구분자(rule)가 정규표현식 객체로 들어온 경우
    elif isinstance(rule, re.Pattern):
        m = p.match(target)
        res = all([m])
    ## 구분자(rule)가 문자열로 들어온 경우
    else:
        res = rule in target
    return res



def form_TypeDict(rowsDictGrps,titleKeyName,sttIdx):
    """
    rowsDictGrps_perType을 받아서 각 그룹의 이름을 키로 하는
    새로운 중첩구조의 Dictionary를 만들어서,
    바깥에서 타입이름으로 딕셔너리에 접근하면 
    바로 해당 구성내용을 반환해주는 데이터 구조를 만드는 함수
    """
    typeDict = go(#>
        rowsDictGrps, list,
        filter(lambda x: x!=[]),
        map(lambda rowsDictGrp: \
            ### 그룹 전체 첫행 중 타이틀키값과 나머지 row 들 dict를 짝지어 새로운 딕셔너리로 형성
            [list(rowsDictGrp)[0][titleKeyName],go(#>>
                list(rowsDictGrp)[sttIdx:],
                #### 모두 빈칸인 값일때 제외 필터링
                filter(lambda row: any(list(map(lambda cell: cell!="", list(row.values()))))),
                list,
            )]#<<
        ),list,
        dict,
    )#<
    
    return typeDict

def updateDict_symValPair(calcTypeDict):
    allCalcTypeNames = list(calcTypeDict.keys())
    res = {}
    for x in allCalcTypeNames:
        type = {}
        for rD in calcTypeDict[x]:
            if rD["수동 입력값"]!="" and rD["산출수식 약자"]!="":
                rD["applyForCalc"] = rD["수동 입력값"]
                type[rD["산출수식 약자"]]=rD["applyForCalc"]
            elif rD["Parameter"]!="" and rD["산출수식 약자"]!="":
                rD["applyForCalc"] = rD["Parameter"]
                type[rD["산출수식 약자"]]=rD["applyForCalc"]
        res[x] = type
    return res
   

def find_stdWMdicts_inGrp(rowsDictGrp):
    res = go(
        rowsDictGrp, list,
        ## 엑셀 "물량산출식", "Work Master Code" 열에 값이 없는 행 제외
        filter(lambda rD: rD["입찰_물량산출식"] != "" and rD["실행_물량산출식"] != ""),
        filter(lambda rD: rD["Work Master Code"] != ""),
        ## Family Type Name에 "H_" 문자열 포함된 경우 제외
        filter(lambda rD: not findRow_AppliedType(rD, "Family Type Name", rule="H_")),
        ## 행 딕셔너리의 NO, Standard Type 업데이트
        map(lambda rD: dictUpdate(rD,{"NO":rowsDictGrp[0]["NO"], "Standard Type":rowsDictGrp[0]["Standard Type"]})),
        ## Q'ty Cal Type Tag 업데이트
        map(lambda rD: dictUpdate(rD,{"Q'ty Cal Type Tag":rowsDictGrp[0]["Q'ty Cal Type Tag"]})),
        list,
    )
    return res


def find_stdWMdicts_forCat(rowsDictsGrps):
    res = go(#>
        rowsDictsGrps, list,
        map(find_stdWMdicts_inGrp),
        #filter(lambda x: x!=[]),
        list,
    )#<
    return res

def find_appliedTypeDicts_forCat(rowsDictsGrps):
    eff_hdrs_name = list(rowsDictsGrps[0][0].keys())
    wmspec_headers = ["Work Master Code", "GaugeCode", "Unit"]\
        + list(filter(lambda x: "Work Cat" in x or "Spec" in x, eff_hdrs_name))\
        + ["Description","입찰_물량산출식", "실행_물량산출식"]
    #stdWMsDicts = find_stdWMdicts_forCat(rowsDictGrps)
    
    appliedTypeDicts = go(#>
        rowsDictsGrps,
        map(lambda rowsDictsGrp: go(#>>
            rowsDictsGrp, list,
            ## Family Type Name에 "H_" 문자열 포함된 경우만 필터링
            filter(lambda rD: findRow_AppliedType(rD, "Family Type Name", rule="H_")),
            ## 행 딕셔너리의 NO, Standard Type 업데이트 - 추후 함수 분리 염두
            map(lambda rD: dictUpdate(rD,{"NO":rowsDictsGrp[0]["NO"], "Standard Type":rowsDictsGrp[0]["Standard Type"]})),
            ## 그룹 첫행을 기준으로 Q'ty Cal Type Tag 업데이트 - 추후 함수 분리 염두
            map(lambda rD: dictUpdate(rD,{"Q'ty Cal Type Tag":rowsDictsGrp[0]["Q'ty Cal Type Tag"]})),
            
            # wmSpecs 속성들을 헤더로 하는 새로운 딕셔너리 형성 및 값 추가(값은 list형태)
            map(lambda rD: dictUpdate(rD, {"wmSpecs": go(
                ### wmspec관련 항목들 값을 리스트로 모음
                map(lambda x: rD[x], wmspec_headers), list,
                ### 항목명과 항목값을 모아서 딕셔너리 형태로 변환
                lambda x: zip(wmspec_headers,x), dict,
                ### wmSpecs 항목을 리스트 구조로 수정해 두기
                lambda x: [x] if x["Work Master Code"]!="" else [],
                
            )}) ),
            ## 밖으로 꺼내진 WorkMaster 관련 속성 삭제
            map(lambda rD: dictDeleteKeys(rD, wmspec_headers)), list,
            #filter(lambda rD: rD["wmSpecs"][0]["Work Master Code"]!=""),
            list,
            )#<<
        ),
        # 실적용 패밀리타입이 없는 그룹은 제외하는 구간
        filter(lambda x: list(x)!=[]),
        list,
    )#<
    
    return appliedTypeDicts

def find_appliedTypeDicts_forRoom(rowsDictsGrps):
    eff_hdrs_name = list(rowsDictsGrps[0][0].keys())
    wmspec_headers = ["Work Master Code", "GaugeCode", "Unit"]\
        + list(filter(lambda x: "Work Cat" in x or "Spec" in x, eff_hdrs_name))\
        + ["Description","입찰_물량산출식", "실행_물량산출식"]
    
    appliedTypeDicts = go(#>
        rowsDictsGrps,
        map(lambda rowsDictsGrp: go(#>>
            rowsDictsGrp, list,
            ## Family Type Name에 "H_" 문자열 포함된 경우만 필터링
            filter(lambda rD: findRow_AppliedType(rD, "Standard Type")),
            ## 행 딕셔너리의 NO, Standard Type 업데이트 - 추후 함수 분리 염두
            map(lambda rD: dictUpdate(rD,{"NO":rD["Standard Type"], "Standard Type":rowsDictsGrp[0]["Standard Type"]})),
            ## 그룹 첫행을 기준으로 Q'ty Cal Type Tag 업데이트 - 추후 함수 분리 염두
            map(lambda rD: dictUpdate(rD,{"Q'ty Cal Type Tag":rowsDictsGrp[0]["Q'ty Cal Type Tag"]})),
            
            # wmSpecs 속성들을 헤더로 하는 새로운 딕셔너리 형성 및 값 추가(값은 list형태)
            map(lambda rD: dictUpdate(rD, {"wmSpecs": go(
                ### wmspec관련 항목들 값을 리스트로 모음
                map(lambda x: rD[x], wmspec_headers), list,
                ### 항목명과 항목값을 모아서 딕셔너리 형태로 변환
                lambda x: zip(wmspec_headers,x), dict,
                ### wmSpecs 항목을 리스트 구조로 수정해 두기
                lambda x: [x] if x["Work Master Code"]!="" else [],
                
            )}) ),
            ## 밖으로 꺼내진 WorkMaster 관련 속성 삭제
            map(lambda rD: dictDeleteKeys(rD, wmspec_headers)), list,
            #filter(lambda rD: rD["wmSpecs"][0]["Work Master Code"]!=""),
            list,
            )#<<
        ),
        # 실적용 패밀리타입이 없는 그룹은 제외하는 구간
        filter(lambda x: list(x)!=[]),
        list,
    )#<
    
    return appliedTypeDicts

def merge_sameFamType_wmSpecs(appliedTypeDicts):
    def merge_inGrp(appliedTypeDicts_perGrp):
        """
        엑셀 타입별 행그룹 내에서 실 적용 패일리명이 들어있는
        행들만 추출하고, 그 중 이름이 같은 것들의 wm 정보는 합쳐서
        하나의 이름에 하나의 딕셔너리 객체만 존재하도록 수정
        """
        ## 그룹 내 실 적용 패밀리 타입 명 추출(중복 불허)
        keysPerGrp = go(#>
            appliedTypeDicts_perGrp,
            ## 개별 행딕셔너리의 패밀리 타입 항목 값 추출
            map(lambda rD: rD["Family Type Name"]),
            ## 문자열 내 "H_"가 포함되어있는 지 검사
            filter(lambda x: "H_" in x),
            ## 중복 Family Type Name 단일화
            set, list,
        )#<
        ## 패밀리 타입 명을 k라는 변수명으로 하나씩 순회
        for k in keysPerGrp:
            ### k라는 패밀리 타입 명에 해당하는 딕셔너리 모두 검색
            sameNameDicts = list(filter(lambda x: x["Family Type Name"] == k, appliedTypeDicts_perGrp))
            ### 하나의 타입명에 복수 객체인지를 검사하여
            ### 2개 이상인 경우
            if len(sameNameDicts)>=2:
                ### 동일 이름의 딕셔너리들 중 첫번째 항목의 "wmSpecs"에
                ### 나머지 항목의 wmSpecs 항목을 몰아준다
                for i,rD in enumerate(sameNameDicts[1:]):
                    sameNameDicts[0]["wmSpecs"].append(*rD["wmSpecs"])
                ### 몰아주기가 끝나면, 첫번째를 제외한 나머지 딕셔너리는
                ### 불필요해지므로 삭제
                appliedTypeDicts_perGrp.remove(sameNameDicts[i+1])
            else:                
                pass
        ## 수정된 딕셔너리들 리스트를 반환
        return appliedTypeDicts_perGrp
    # 단위 그룹에 대한 함수를 복수 그룹들 전체에 시행
    return map(merge_inGrp, appliedTypeDicts)



def inject_stdWMtoAppliedTypeDicts(appliedTypeDicts, allCat_stdWMdicts_stdTypeName):
    def inject_inGrp(appliedTypeDict_perGrp):
        """
        타입 그룹 별 공통 WM 딕셔너리 항목들을
        실적용패밀리 딕셔너리에 주입하는 함수
        """
        ## 실적용패밀리 딕셔너리 리스트의 구성 원소 각각을
        ## rD(rowDictionary) 라는 이름으로 순회
        for rD in appliedTypeDict_perGrp:
            ### rD의 "Standard Type" 항목 값이
            ### 입력받은 타입별 공통 WM항목 딕셔너리의 키값중에
            ### 포함되었는지 검사후 있으면,
            if rD["Standard Type"] in list(allCat_stdWMdicts_stdTypeName.keys()):
                #### rD의 "wmSpecs" 항목에 공통 WM항목을 추가하여 재할당
                rD["wmSpecs"] = rD["wmSpecs"] + allCat_stdWMdicts_stdTypeName[rD["Standard Type"]]
            else:
                pass
        ## 수정된 딕셔너리들 리스트를 반환
        return appliedTypeDict_perGrp
    # 단위 그룹에 대한 함수를 복수 그룹들 전체에 시행
    return list(map(inject_inGrp, appliedTypeDicts))
    
def updateFamTypeDicts_symValPair(total_appliedTypeDicts, calcTypeDict_symValPair):
    """
    실적용패밀리타입명 별 딕셔너리에
    "Q'ty Cal Type Tag" 항목 값 이름과 일치하는
    물량산출 매개변수 꾸러미 추가하는 함수
    """
    # 전체 결과물 담을 빈 딕셔너리 선언
    res = {}
    # 전체 실적용 패밀리 딕셔너리들 중 구성원소 각각을 d라는 이름으로 순회
    for d in total_appliedTypeDicts:
        ## 딕셔너리의 "Q'ty Cal Type Tag"항목의 값이 빈문자열이 아니라면,
        if d["Q'ty Cal Type Tag"]!="":
            ### 딕셔너리에 "Sym_Val Dict"라는 키를 추가하고
            ### calcTypeDict 중 일치하는 값을 골라 키의 값으로 할당
            symValPair = calcTypeDict_symValPair[d["Q'ty Cal Type Tag"]]
            d["Sym_Val Dict"] = symValPair
        ## 전체용 빈 딕셔너리에 패밀리 타입명을 키로 추가하고
        ## 방금 수정한 단위 딕셔너리를 키의 값으로 할당
        res[d["Family Type Name"]] = d    
    return res
    
    
    
    
calcSheet_rowsListGrps_perType = get_DataOnGrpsAtSheet(calcStdSheet, "구간판별", "#")
calcSheet_rowsDictGrps_perType = cvt_rowsListGrps_toDictGrps(*calcSheet_rowsListGrps_perType)
calcTypeDict = form_TypeDict(calcSheet_rowsDictGrps_perType,"Q'ty Cal Type Tag",sttIdx=1)
calcTypeDict_symValPair = updateDict_symValPair(calcTypeDict)

roomSheet_rowsListGrps_perType = get_DataOnGrpsAtSheet(allCatSheets[0], "Standard Type", "H_")
roomSheet_rowsDictGrps_perType = cvt_rowsListGrps_toDictGrps(*roomSheet_rowsListGrps_perType)
room_stdWMdicts = find_stdWMdicts_forCat(deepcopy(roomSheet_rowsDictGrps_perType))
room_stdWMdicts_stdTypeName = form_TypeDict(room_stdWMdicts, "Standard Type",sttIdx=0)

room_appliedTypeDicts = find_appliedTypeDicts_forRoom(roomSheet_rowsDictGrps_perType)
room_appliedTypeDicts_noDupl = merge_sameFamType_wmSpecs(room_appliedTypeDicts)

room_appliedTypeDicts_withStdWm = list(chain(*inject_stdWMtoAppliedTypeDicts(room_appliedTypeDicts_noDupl, room_stdWMdicts_stdTypeName)))

# 룸 제외 모든 카테고리 시트 처리
allCatSheet_rowsListGrps = map( lambda x: get_DataOnGrpsAtSheet(x, "Standard Type", "H_"), allCatSheets[1:] )
allCatSheet_rowsDictGrps = map( lambda x: cvt_rowsListGrps_toDictGrps(*x), allCatSheet_rowsListGrps )

# "Standard Type" 별 wm 공통항목 찾기
allCat_stdWMdicts = list(map( lambda x: find_stdWMdicts_forCat(x), deepcopy(allCatSheet_rowsDictGrps) ))
# "Standard Type" 명으로 검색할 수 있는, 전 카테고리 "Standard Type" 별 공통 WM항목 사전 만들기
allCat_stdWMdicts_stdTypeName = dictsMerge(list(map(lambda x: form_TypeDict(x, "Standard Type",sttIdx=0), allCat_stdWMdicts)))

allCat_appliedTypeDicts = map( lambda x: find_appliedTypeDicts_forCat(x), allCatSheet_rowsDictGrps )
allCat_appliedTypeDicts_noDupl = map( lambda x: merge_sameFamType_wmSpecs(x), allCat_appliedTypeDicts )

allCat_appliedTypeDicts_withStdWm = list(chain(*chain(*map( lambda x: inject_stdWMtoAppliedTypeDicts(x,allCat_stdWMdicts_stdTypeName), allCat_appliedTypeDicts_noDupl ))))

total_appliedTypeDicts = room_appliedTypeDicts_withStdWm + allCat_appliedTypeDicts_withStdWm
FamTypeDicts_symValPair = updateFamTypeDicts_symValPair(total_appliedTypeDicts,calcTypeDict_symValPair)

# Assign your output to the OUT variable.

OUT = FamTypeDicts_symValPair
# ----------------------------------------
code_block_32 = CodeBlock { 0; }
물량산출모드_입찰_실행 = CustomSelection("실행", items={입찰: "입찰", 실행: "실행"})  # graph input
list_create_4 = List.Create(item0=join_3, item1=flatten)

# group: Excel Dictionarize & 레빗 객체와 결합 딕셔너리 형성 및 심볼 / 값 추출
excel_data_dictionarization_3_0_3 = Python(IN[0]=lang_mode_영_한_select_2, IN[1]=importExcel, IN[2]=target_sheet_names, IN[3]=list_create_4)  # "Excel data dictionarization_3.0.2"; CPython3
# ---------- excel_data_dictionarization_3_0_3.python (524 lines) ----------
# Load the Python Standard and DesignScript Libraries"
import sys
import clr
clr.AddReference('ProtoGeometry')
from Autodesk.DesignScript.Geometry import *

################Module For Functional Programing##########################
from functools import reduce
from itertools import chain
from itertools import groupby
from copy import deepcopy
curry = lambda f: lambda a,*args: f(a, *args) if (len(args)) else lambda *args: f(a, *args)

filter = curry(filter)
map = curry(map)
reduce = curry(reduce)

go = lambda *args: reduce(lambda a,f: f(a), args) ## 함수도 축약 가능 ##

def dictUpdate(dic1,dic2):
    res = dic1.update(dic2)
    #res = {**dic1,**dic2}
    return dic1 #res
    
def dictsMerge(dics):
    res = reduce(dictUpdate, dics)
    return res
    
def dictDeleteKeys(dic, keys):
    for k in keys:
        del dic[k]
    return dic
##########################################################################

import re
from functools import partial

# The inputs to this node will be stored as a list in the IN variables.
dataEnteringNode = IN
lang_mode = IN[0]
wholeDatas = IN[1]
db = wholeDatas[1:]
allCatSheetsNames = IN[2][2:]

calcStdSheet = db[0] ##산출기준 시트
allCatSheets = db[1:]

allElemsNames = IN[3][0]
allElems = IN[3][1]
allElemsSet = list(zip(allElemsNames, allElems))


#wmspec_headers = [
#    "Work Master Code" ,"GaugeCode" ,"Unit" ,"Work Category-L1"
#    ,"Work Category-L2" ,"Work Category-L3" ,"Spec. 1- L4" ,"Spec. 2- L5"
#    ,"Spec. 3- L6" ,"Spec. 4- L7" ,"Spec. 5- L8" ,"Spec. 6- L9"
#    ,"Spec. 7- L10" ,"Spec. 8- L11" ,"BOQ Spec1" ,"BOQ Spec2" ,"BOQ Spec3"
#    ,"BOQ Spec4" ,"BOQ Spec5" ,"BOQ Spec6" ,"BOQ Spec7" ,"BOQ Spec8" ,"BOQ Spec9"
#    ,"Description" ,"입찰_물량산출식" ,"실행_물량산출식" ,"rIDX"
#]
# Place your code below this line

def find_IsInStr(target, string):
    if target == None or string == None:
        pass
    else:
        res = str(target) in str(string)
        return res

def find_range_by_columnItem(db, col_idx, sep_rule):
    tdb = list(map(lambda x: x[col_idx], db)) ##targetTransposedDB (col_idx에 해당하는 데이터만 추출)
    last_idx_tdb = len(tdb)-1
    tdb_enum = enumerate(tdb)
    target_RowNumber = list(filter(lambda x: find_IsInStr(sep_rule, x[1]), tdb_enum))
    endidxs_tmp= list(map(lambda x: x[0]-1,target_RowNumber))
    endidxs_tmp.pop(0)
    endidxs = endidxs_tmp + [last_idx_tdb] ## 각 구간별 마지막 행 번호
    rangeSttIdxs = list(map(lambda x: x[0]+1,target_RowNumber))
    rangeEndIdxs = endidxs
    result = list(zip(rangeSttIdxs, rangeEndIdxs))
    return result

    
def find_headersAtSheet(sheet):
    headers_sheet = list(map(lambda x: [x[1].replace("\n",""),x[0]], filter(lambda x: x[1] != None, enumerate(sheet[1]))))
    
    return dict(headers_sheet)
    #return list(headers_sheet)

def find_rangesAtSheet(sheet, hdrs_withIdxDict, trgt_hdr, trgt_str):
    #hdrs_withIdxDict = dict(hdrs_withIdx)
    return find_range_by_columnItem(sheet, hdrs_withIdxDict[trgt_hdr], trgt_str)


def get_DataOnGrpsAtSheet(sheet:list, discrHDRStr, discrRowStr):
    """
    판별기준 Header문자열(discrHDRStr)이 들어있는 열에서,
    판별기준 행 문자열(discrRowStr)이 들어있는 행번호 기준으로 구역을 나누어 데이터 리스트 반환
    """
    hdrs_withIdxDict = find_headersAtSheet(sheet)

    # 시트별 그룹 구분 (시작 행번호, 끝 행 번호 추출)
    rowAreasAtSheet = find_rangesAtSheet(sheet, hdrs_withIdxDict, discrHDRStr, discrRowStr)
    
    # 시트 각행에 rIDX 데이터 주입하는 구간 - (시작) >>>>>>>
    ## 헤더의 칼럼 인덱스 중 가장 큰 것 추출
    hdrs_maxCol_idx = max(list(hdrs_withIdxDict.values()))
    ## 마지막 헤더보더 한칸 옆을 행인덱스번호("rIDX") 정보 보관 위치로 설정
    hdrs_withIdxDict["rIDX"] = hdrs_maxCol_idx+1
    ## 시트의 각 행을 번호와 함께 pair 형태로 추출
    sheetWith_rIDX = list(enumerate(sheet))
    ## rIDX 보관된 시트 데이터 저장을 위한 빈 리스트 선언
    sheet_rIDX = []
    ## pair 형태의 각 행에서, 마지막 헤더의 한칸 우측위치에 rIDX 데이터 주입
    ## 시트의 각 행마다 x 라는 이름으로 순회하며,
    for x in sheetWith_rIDX:
        ### 행의 전체 데이터 길이가 마지막 헤더 위치보다 클때,
        if len(x)<hdrs_maxCol_idx:
            #### 마지막 헤더의 우측 칸 위치를 rIDX 데이터로 치환
            x[1][hdrs_maxCol_idx+1] = x[0]
            sheet_rIDX.append(x[1])
            
        ### 행의 전체 데이터 길이가 마지막 헤더 위치와 같을때,
        else:
            #### 마지막 헤더의 우측칸이 없으므로 append로 rIDX 데이터 추가
            x[1].append(x[0])
            sheet_rIDX.append(x[1])
    # <<<<< 시트 각행에 rIDX 데이터 주입하는 구간 - (끝)
    
    rowsGrps_perType_withNone = list(map(lambda x: sheet_rIDX[x[0]-1:x[1]], rowAreasAtSheet))
    # None 데이터 치환 구간
    rowsListGrps_perType = go(#>
        rowsGrps_perType_withNone, list,
        ## 하나의 타입을 규정하는 행들의 모임에서
        map(lambda rowGrp: \
        ## 한 행씩 골라서
        list(map(lambda row: \
        ## 행을 구성하는 셀 값 중 None이 있으면 빈문자열로 치환
        list(map(lambda cell: "" if cell==None else cell, row)), rowGrp)) ),
        ## 맵 객체가 반환되므로 리스트 변환
        list,
    )#<
    
    return (rowsListGrps_perType, hdrs_withIdxDict)

def cvt_rowsListGrps_toDictGrps(rowsListGrps_perType, hdrs_withIdxDict):
    """
    헤더 행과 다수의 컨텐츠 행으로 이루어진 rowListGrps를,
    모든 행을 헤더와 결합된 딕셔너리화 해서 rowDictGrps를 만드는 함수
    """
    eff_hdrs_idx = hdrs_withIdxDict.values()
    eff_hdrs_name = hdrs_withIdxDict.keys()
    
    rowsDictGrps_perType = go(#>
        rowsListGrps_perType,
        ## 하나의 타입을 규정하는 행들의 모임에서 한 행 씩 조작하는 함수들을 구상 후
        ## 맵 함수 내에서 go로 합성하여 반복시켜 사용
        map(lambda rowGrp: go(#>>
            ### 그룹 전체 가져와서
            rowGrp,
            ### 각 행을 리스트 타입으로 변환
            map(list), list,
            ### 헤더에 해당하는 행 값을 추출--
            map(lambda row: list(map(lambda idx: row[idx], eff_hdrs_idx))), list,
            ### 헤더이름과 행 내부의 값을 2개씩 짝지어 줌
            map(lambda row: list(zip(eff_hdrs_name, row))), list,
            ### 헤더이름 : 값의 형태로 각 행 데이터를 딕셔너리로 만듬
            map(lambda x: dict(x)), list,
            )#<<
        ), list,
    )#<
    return rowsDictGrps_perType

# 행딕셔너리 별 입력한 규칙에 따라 참거짓 여부를 반환하는 함수
def findRow_AppliedType(rowDict, tgtHDRname, rule=None):
    p = re.compile('[0-9]{3,5}')
    target = str(rowDict[tgtHDRname])
    ## 함수 호출시 구분자(rule) 없이 호출한 경우
    ## -Room Category 시트 용 이며 "Standard Type" 항목의 값이 000형태의 숫자인지를 판별
    ## -Room Category 중 "Standard Type" 칼럼에 룸 넘버, "Family Type Name" 칼럼에 룸 이름 입력하게 되어있음
    if rule==None:
        p = re.compile('[0-9]{3,5}')
        m = p.match(target)
        stdCase = target =="Room No"
        res = all([m or stdCase])
    ## 구분자(rule)가 정규표현식 객체로 들어온 경우
    elif isinstance(rule, re.Pattern):
        m = p.match(target)
        res = all([m])
    ## 구분자(rule)가 문자열로 들어온 경우
    else:
        res = rule in target
    return res



def form_TypeDict(rowsDictGrps,titleKeyName,sttIdx):
    """
    rowsDictGrps_perType을 받아서 각 그룹의 이름을 키로 하는
    새로운 중첩구조의 Dictionary를 만들어서,
    바깥에서 타입이름으로 딕셔너리에 접근하면 
    바로 해당 구성내용을 반환해주는 데이터 구조를 만드는 함수
    """
    typeDict = go(#>
        rowsDictGrps, list,
        filter(lambda x: x!=[]),
        map(lambda rowsDictGrp: \
            ### 그룹 전체 첫행 중 타이틀키값과 나머지 row 들 dict를 짝지어 새로운 딕셔너리로 형성
            [list(rowsDictGrp)[0][titleKeyName],go(#>>
                list(rowsDictGrp)[sttIdx:],
                #### 모두 빈칸인 값일때 제외 필터링
                filter(lambda row: any(list(map(lambda cell: cell!="", list(row.values()))))),
                list,
            )]#<<
        ),list,
        dict,
    )#<
    
    return typeDict

def updateDict_symValPair(calcTypeDict):
    allCalcTypeNames = list(calcTypeDict.keys())
    res = {}
    for x in allCalcTypeNames:
        type = {}
        for rD in calcTypeDict[x]:
            if rD["수동 입력값"]!="" and rD["산출수식 약자"]!="":
                rD["applyForCalc"] = rD["수동 입력값"]
                type[rD["산출수식 약자"]]=rD["applyForCalc"]
            elif rD["Parameter"]!="" and rD["산출수식 약자"]!="":
                rD["applyForCalc"] = rD["Parameter"]
                type[rD["산출수식 약자"]]=rD["applyForCalc"]
        res[x] = type
    return res
   

def find_stdWMdicts_inGrp(rowsDictGrp):
    res = go(
        rowsDictGrp, list,
        ## 엑셀 "물량산출식", "Work Master Code" 열에 값이 없는 행 제외
        filter(lambda rD: rD["입찰_물량산출식"] != "" and rD["실행_물량산출식"] != ""),
        filter(lambda rD: rD["Work Master Code"] != ""),
        ## Family Type Name에 "H_" 문자열 포함된 경우 제외
        filter(lambda rD: not findRow_AppliedType(rD, "Family Type Name", rule="H_")),
        ## 행 딕셔너리의 NO, Standard Type 업데이트
        map(lambda rD: dictUpdate(rD,{"NO":rowsDictGrp[0]["NO"], "Standard Type":rowsDictGrp[0]["Standard Type"]})),
        ## Q'ty Cal Type Tag 업데이트
        map(lambda rD: dictUpdate(rD,{"Q'ty Cal Type Tag":rowsDictGrp[0]["Q'ty Cal Type Tag"]})),
        list,
    )
    return res


def find_stdWMdicts_forCat(rowsDictsGrps):
    res = go(#>
        rowsDictsGrps, list,
        map(find_stdWMdicts_inGrp),
        #filter(lambda x: x!=[]),
        list,
    )#<
    return res

def find_appliedTypeDicts_forCat(rowsDictsGrps):
    eff_hdrs_name = list(rowsDictsGrps[0][0].keys())
    wmspec_headers = ["Work Master Code", "GaugeCode", "Unit"]\
        + list(filter(lambda x: "Work Cat" in x or "Spec" in x, eff_hdrs_name))\
        + ["Description","입찰_물량산출식", "실행_물량산출식", "rIDX"]
    #stdWMsDicts = find_stdWMdicts_forCat(rowsDictGrps)
    
    appliedTypeDicts = go(#>
        rowsDictsGrps,
        map(lambda rowsDictsGrp: go(#>>
            rowsDictsGrp, list,
            ## Family Type Name에 "H_" 문자열 포함된 경우만 필터링
            filter(lambda rD: findRow_AppliedType(rD, "Family Type Name", rule="H_")),
            ## 행 딕셔너리의 NO, Standard Type 업데이트 - 추후 함수 분리 염두
            map(lambda rD: dictUpdate(rD,{"NO":rowsDictsGrp[0]["NO"], "Standard Type":rowsDictsGrp[0]["Standard Type"]})),
            ## 그룹 첫행을 기준으로 Q'ty Cal Type Tag 업데이트 - 추후 함수 분리 염두
            map(lambda rD: dictUpdate(rD,{"Q'ty Cal Type Tag":rowsDictsGrp[0]["Q'ty Cal Type Tag"]})),
            
            # wmSpecs 속성들을 헤더로 하는 새로운 딕셔너리 형성 및 값 추가(값은 list형태)
            map(lambda rD: dictUpdate(rD, {"wmSpecs": go(
                ### wmspec관련 항목들 값을 리스트로 모음
                map(lambda x: rD[x], wmspec_headers), list,
                ### 항목명과 항목값을 모아서 딕셔너리 형태로 변환
                lambda x: zip(wmspec_headers,x), dict,
                ### wmSpecs 항목을 리스트 구조로 수정해 두기
                lambda x: [x] if x["Work Master Code"]!="" else [],
                
            )}) ),
            ## 밖으로 꺼내진 WorkMaster 관련 속성 삭제
            map(lambda rD: dictDeleteKeys(rD, wmspec_headers)), list,
            list,
            )#<<
        ),
        # 실적용 패밀리타입이 없는 그룹은 제외하는 구간
        filter(lambda x: list(x)!=[]),
        list,
    )#<
    
    return appliedTypeDicts

def find_appliedTypeDicts_forRoom(rowsDictsGrps):
    eff_hdrs_name = list(rowsDictsGrps[0][0].keys())
    wmspec_headers = ["Work Master Code", "GaugeCode", "Unit"]\
        + list(filter(lambda x: "Work Cat" in x or "Spec" in x, eff_hdrs_name))\
        + ["Description","입찰_물량산출식", "실행_물량산출식", "rIDX"]
    
    appliedTypeDicts = go(#>
        rowsDictsGrps,
        map(lambda rowsDictsGrp: go(#>>
            rowsDictsGrp, list,
            ## Standard Type 에 "H_" 문자열 포함된 경우만 필터링(only for room)
            filter(lambda rD: findRow_AppliedType(rD, "Standard Type")),
            ## 행 딕셔너리의 NO, Standard Type 업데이트 - 추후 함수 분리 염두
            map(lambda rD: dictUpdate(rD,{"NO":rD["Standard Type"], "Standard Type":rowsDictsGrp[0]["Standard Type"]})),
            ## 그룹 첫행을 기준으로 Q'ty Cal Type Tag 업데이트 - 추후 함수 분리 염두
            map(lambda rD: dictUpdate(rD,{"Q'ty Cal Type Tag":rowsDictsGrp[0]["Q'ty Cal Type Tag"]})),
            
            # wmSpecs 속성들을 헤더로 하는 새로운 딕셔너리 형성 및 값 추가(값은 list형태)
            map(lambda rD: dictUpdate(rD, {"wmSpecs": go(
                ### wmspec관련 항목들 값을 리스트로 모음
                map(lambda x: rD[x], wmspec_headers), list,
                ### 항목명과 항목값을 모아서 딕셔너리 형태로 변환
                lambda x: zip(wmspec_headers,x), dict,
                ### wmSpecs 항목을 리스트 구조로 수정해 두기
                lambda x: [x] if x["Work Master Code"]!="" else [],
                
            )}) ),
            ## 밖으로 꺼내진 WorkMaster 관련 속성 삭제
            map(lambda rD: dictDeleteKeys(rD, wmspec_headers)), list,
            
            ## Room 의 경우는 "No"와 "Family Type Name"을 합쳐서 "Family Type Name"에 입력
            map(lambda rD: dictUpdate(rD,{"Family Type Name":str(rD["NO"]).split('.')[0]+"_"+rD["Family Type Name"]})),
            
            list,
            )#<<
        ),
        # 실적용 패밀리타입이 없는 그룹은 제외하는 구간
        filter(lambda x: list(x)!=[]),
        list,
    )#<
    
    return appliedTypeDicts

def merge_sameFamType_wmSpecs(appliedTypeDicts):
    def merge_inGrp(appliedTypeDicts_perGrp):
        """
        엑셀 타입별 행그룹 내에서 실 적용 패일리명이 들어있는
        행들만 추출하고, 그 중 이름이 같은 것들의 wm 정보는 합쳐서
        하나의 이름에 하나의 딕셔너리 객체만 존재하도록 수정
        """
        ## 그룹 내 실 적용 패밀리 타입 명 추출(중복 불허)
        keysPerGrp = go(#>
            appliedTypeDicts_perGrp,
            ## 개별 행딕셔너리의 패밀리 타입 항목 값 추출
            map(lambda rD: rD["Family Type Name"]),
            ## 문자열 내 "H_"가 포함되어있는 지 검사
            filter(lambda x: "H_" in x),
            ## 중복 Family Type Name 단일화
            set, list,
        )#<
        ## 패밀리 타입 명을 k라는 변수명으로 하나씩 순회
        for k in keysPerGrp:
            ### k라는 패밀리 타입 명에 해당하는 딕셔너리 모두 검색
            sameNameDicts = list(filter(lambda x: x["Family Type Name"] == k, appliedTypeDicts_perGrp))
            ### 하나의 타입명에 복수 객체인지를 검사하여
            ### 2개 이상인 경우
            if len(sameNameDicts)>=2:
                ### 동일 이름의 딕셔너리들 중 첫번째 항목의 "wmSpecs"에
                ### 나머지 항목의 wmSpecs 항목을 몰아준다
                for i,rD in enumerate(sameNameDicts[1:]):
                    sameNameDicts[0]["wmSpecs"].append(*rD["wmSpecs"])
                ### 몰아주기가 끝나면, 첫번째를 제외한 나머지 딕셔너리는
                ### 불필요해지므로 삭제
                appliedTypeDicts_perGrp.remove(sameNameDicts[i+1])
            else:                
                pass
        ## 수정된 딕셔너리들 리스트를 반환
        return appliedTypeDicts_perGrp
    # 단위 그룹에 대한 함수를 복수 그룹들 전체에 시행
    return map(merge_inGrp, appliedTypeDicts)



def inject_stdWMtoAppliedTypeDicts(appliedTypeDicts, allCat_stdWMdicts_stdTypeName):
    def inject_inGrp(appliedTypeDict_perGrp):
        """
        타입 그룹 별 공통 WM 딕셔너리 항목들을
        실적용패밀리 딕셔너리에 주입하는 함수
        """
        ## 실적용패밀리 딕셔너리 리스트의 구성 원소 각각을
        ## rD(rowDictionary) 라는 이름으로 순회
        for rD in appliedTypeDict_perGrp:
            ### rD의 "Standard Type" 항목 값이
            ### 입력받은 타입별 공통 WM항목 딕셔너리의 키값중에
            ### 포함되었는지 검사후 있으면,
            if rD["Standard Type"] in list(allCat_stdWMdicts_stdTypeName.keys()):
                #### rD의 "wmSpecs" 항목에 공통 WM항목을 추가하여 재할당
                rD["wmSpecs"] = rD["wmSpecs"] + allCat_stdWMdicts_stdTypeName[rD["Standard Type"]]
            else:
                pass
        ## 수정된 딕셔너리들 리스트를 반환
        return appliedTypeDict_perGrp
    # 단위 그룹에 대한 함수를 복수 그룹들 전체에 시행
    return list(map(inject_inGrp, appliedTypeDicts))
    
def updateFamTypeDicts_symValPair(total_appliedTypeDicts, calcTypeDict_symValPair):
    """
    실적용패밀리타입명 별 딕셔너리에
    "Q'ty Cal Type Tag" 항목 값 이름과 일치하는
    물량산출 매개변수 꾸러미 추가하는 함수
    """
    # 전체 결과물 담을 빈 딕셔너리 선언
    res = {}
    # 전체 실적용 패밀리 딕셔너리들 중 구성원소 각각을 d라는 이름으로 순회
    for d in total_appliedTypeDicts:
        ## 딕셔너리의 "Q'ty Cal Type Tag"항목의 값이 빈문자열이 아니라면,
        if d["Q'ty Cal Type Tag"]!="":
            ### 딕셔너리에 "Sym_Val Dict"라는 키를 추가하고
            ### calcTypeDict 중 일치하는 값을 골라 키의 값으로 할당
            symValPair = calcTypeDict_symValPair[d["Q'ty Cal Type Tag"]]
            d["Sym_Val Dict"] = symValPair
        ## 전체용 빈 딕셔너리에 패밀리 타입명을 키로 추가하고
        ## 방금 수정한 단위 딕셔너리를 키의 값으로 할당
        res[d["Family Type Name"]] = d    
    return res
    
def matchWith_Elem_Dict(famlist_dic,revitElems):
    """
    레빗객체와 패밀리리스트 딕셔너리의 정보를 하나로 결합해주는 용도의 함수
    패밀리리스트 데이터는 패밀리 타입명을 키값으로 하는 하나의 딕셔너리로 정리되어있어야 한다
    revit객체는 패밀리리스트 상 존재하는 타입만 필터링해서 입력해야 함
    """
    # 수행결과를 모을 빈 리스트 선언
    res = []
    # 모든 레빗 객체들을 하나씩 순회 
    for i in revitElems:
        ## revit 객체들과 revit 타입별 Family List 딕셔너리를 결합하기 위한 빈 딕셔너리 선언
        combD = {}
        ## 패밀리 타입명 추출 - Room 객체인 경우와 아닌 경우 분기
        if "Room" in str(type(i)):
            famTypeName = i.GetParameterValueByName("Number") + "_" + i.GetParameterValueByName("Name")
        else:
            famTypeName = i.GetParameterValueByName("Type").GetParameterValueByName("Type Name")
        ## 결합용 딕셔너리의 "Elem" 이라는 키에 순회 중인 i (revit객체)를 할당
        combD["Elem"] = i
        ## 결합용 딕셔너리의 "wms" 이라는 키에 
        ## 순회 중인 i (revit객체) 패밀리 타입 명과 일치하는 famlist_dictionary의 값을 할당
        combD["wms"] = deepcopy(famlist_dic[famTypeName])
        ##결합된 딕셔너리를 res에 저장
        res.append(combD)
    # 전체 수행 결과 반환
    return res

def update_sym_valDict(matched_elemDicts):
    def update_sym_valDict_single(d):
        """
        딕셔너리별로 포함된 ["wms"]["Sym_Val Dict"]항목 내에
        아직 계산되지 않은 매개변수 값들을 계산하여
        "Post_Sym_Val Dict"라는 새로운 키의 값으로 할당하는 함수
        """
        e = d["Elem"]
        newSymValDict = {}
        keys = d["wms"]["Sym_Val Dict"].keys()
        vals = d["wms"]["Sym_Val Dict"].values()
        for s,v in zip(keys, vals):
            ## Vals 항목이 사용자 입력값이 아닌 revit 매개변수인 경우
            if isinstance(v,str):
                if v not in list(map(lambda x: x.Name, e.Parameters)):
                    calc_v = e.ElementType.GetParameterValueByName(v)
                else:
                    calc_v = e.GetParameterValueByName(v)
                calc_vv= calc_v if isinstance(calc_v, str) else round(calc_v, 3)
                newSymValDict[s] = calc_vv
            ## Vals 항목이 사용자 입력값인 경우는 그대로 입력된 숫자 사용
            else:
                newSymValDict[s] = v
        d["wms"]["Post_Sym_Val Dict"] = newSymValDict
        
        return d
    return list(map(update_sym_valDict_single, matched_elemDicts))



    
calcSheet_rowsListGrps_perType = get_DataOnGrpsAtSheet(calcStdSheet, "구간판별", "#")
calcSheet_rowsDictGrps_perType = cvt_rowsListGrps_toDictGrps(*calcSheet_rowsListGrps_perType)
calcTypeDict = form_TypeDict(calcSheet_rowsDictGrps_perType,"Q'ty Cal Type Tag",sttIdx=1)
calcTypeDict_symValPair = updateDict_symValPair(calcTypeDict)

roomSheet_rowsListGrps_perType = get_DataOnGrpsAtSheet(allCatSheets[0], "Standard Type", "H_")
roomSheet_rowsDictGrps_perType = cvt_rowsListGrps_toDictGrps(*roomSheet_rowsListGrps_perType)
room_stdWMdicts = find_stdWMdicts_forCat(deepcopy(roomSheet_rowsDictGrps_perType))
room_stdWMdicts_stdTypeName = form_TypeDict(room_stdWMdicts, "Standard Type",sttIdx=0)

room_appliedTypeDicts = find_appliedTypeDicts_forRoom(roomSheet_rowsDictGrps_perType)
room_appliedTypeDicts_noDupl = merge_sameFamType_wmSpecs(room_appliedTypeDicts)

room_appliedTypeDicts_withStdWm = list(chain(*inject_stdWMtoAppliedTypeDicts(room_appliedTypeDicts_noDupl, room_stdWMdicts_stdTypeName)))

# 룸 제외 모든 카테고리 시트 처리
allCatSheet_rowsListGrps = map( lambda x: get_DataOnGrpsAtSheet(x, "Standard Type", "H_"), allCatSheets[1:] )
allCatSheet_rowsDictGrps = map( lambda x: cvt_rowsListGrps_toDictGrps(*x), allCatSheet_rowsListGrps )

# "Standard Type" 별 wm 공통항목 찾기
allCat_stdWMdicts = list(map( lambda x: find_stdWMdicts_forCat(x), deepcopy(allCatSheet_rowsDictGrps) ))
# "Standard Type" 명으로 검색할 수 있는, 전 카테고리 "Standard Type" 별 공통 WM항목 사전 만들기
allCat_stdWMdicts_stdTypeName = dictsMerge(list(map(lambda x: form_TypeDict(x, "Standard Type",sttIdx=0), allCat_stdWMdicts)))

allCat_appliedTypeDicts = map( lambda x: find_appliedTypeDicts_forCat(x), allCatSheet_rowsDictGrps )
allCat_appliedTypeDicts_noDupl = map( lambda x: merge_sameFamType_wmSpecs(x), allCat_appliedTypeDicts )

allCat_appliedTypeDicts_withStdWm = list(chain(*chain(*map( lambda x: inject_stdWMtoAppliedTypeDicts(x,allCat_stdWMdicts_stdTypeName), allCat_appliedTypeDicts_noDupl ))))

total_appliedTypeDicts = room_appliedTypeDicts_withStdWm + allCat_appliedTypeDicts_withStdWm
FamTypeDicts_symValPair = updateFamTypeDicts_symValPair(total_appliedTypeDicts,calcTypeDict_symValPair)

allUsedFamTypeNames_Excel = FamTypeDicts_symValPair.keys()
allElemsFiltered_byExcel = list(map(lambda y: y[1], list(filter(lambda x: x[0] in allUsedFamTypeNames_Excel , allElemsSet))))

# Assign your output to the OUT variable.

OUT = update_sym_valDict(matchWith_Elem_Dict(FamTypeDicts_symValPair, allElemsFiltered_byExcel))
# ----------------------------------------

토공관련_wm들_물량산출_수식_임시처리구간 = Python(IN[0]=excel_data_dictionarization_3_0_3)  # CPython3
# ---------- 토공관련_wm들_물량산출_수식_임시처리구간.python (56 lines) ----------
# Load the Python Standard and DesignScript Libraries
import sys
import clr
clr.AddReference('ProtoGeometry')
from Autodesk.DesignScript.Geometry import *

################Module For Functional Programing##########################
from functools import reduce
from itertools import chain
from itertools import groupby
from copy import deepcopy
curry = lambda f: lambda a,*args: f(a, *args) if (len(args)) else lambda *args: f(a, *args)

filter = curry(filter)
map = curry(map)
reduce = curry(reduce)

go = lambda *args: reduce(lambda a,f: f(a), args) ## 함수도 축약 가능 ##

def dictUpdate(dic1,dic2):
    res = dic1.update(dic2)
    #res = {**dic1,**dic2}
    return dic1 #res
    
def dictsMerge(dics):
    res = reduce(dictUpdate, dics)
    return res
    
def dictDeleteKeys(dic, keys):
    for k in keys:
        del dic[k]
    return dic
##########################################################################

# The inputs to this node will be stored as a list in the IN variables.
dataEnteringNode = IN
elemDicts = IN[0]
#test_sample = elemDicts[303]

# Place your code below this line

def tmp_switchEarthworkFormula(elemDict):
    
    for i in elemDict["wms"]["wmSpecs"]:
        calcFormulas = filter(lambda x: "산출식" in x ,list(i.Keys))
        for k in calcFormulas:
            if i[k] in ["=Exca", "=Back", "=Disp"]:
                i[k] = "_tbd"
        
    return elemDict

def tmp_switchEarthworkFormula_allDicts(elemDicts):
    return list(map(tmp_switchEarthworkFormula, elemDicts))

# Assign your output to the OUT variable.
OUT = tmp_switchEarthworkFormula_allDicts(elemDicts)
# ----------------------------------------
부재_wm_별_산식에_의한_최종_계산 = Python(IN[0]=물량산출모드_입찰_실행, IN[1]=토공관련_wm들_물량산출_수식_임시처리구간)  # CPython3
# ---------- 부재_wm_별_산식에_의한_최종_계산.python (118 lines) ----------
# Load the Python Standard and DesignScript Libraries
import sys
import clr

clr.AddReference('RevitAPI')
from Autodesk.Revit.DB import *
import Autodesk

clr.AddReference('RevitNodes')
import Revit
clr.ImportExtensions(Revit.Elements)

clr.AddReference('RevitServices')
import RevitServices
from RevitServices.Persistence import DocumentManager
from RevitServices.Transactions import TransactionManager
doc = DocumentManager.Instance.CurrentDBDocument
uiapp = DocumentManager.Instance.CurrentUIApplication
app = uiapp.Application
#collector1 = FilteredElementCollector(doc)

clr.AddReference('ProtoGeometry')
from Autodesk.DesignScript.Geometry import *

################Module For Functional Programing##########################
from functools import reduce
from itertools import chain
from itertools import groupby
from copy import deepcopy
curry = lambda f: lambda a,*args: f(a, *args) if (len(args)) else lambda *args: f(a, *args)

filter = curry(filter)
map = curry(map)
reduce = curry(reduce)

go = lambda *args: reduce(lambda a,f: f(a), args) ## 함수도 축약 가능 ##

def dictUpdate(dic1,dic2):
    res = dic1.update(dic2)
    #res = {**dic1,**dic2}
    return dic1 #res
    
def dictsMerge(dics):
    res = reduce(dictUpdate, dics)
    return res
    
def dictDeleteKeys(dic, keys):
    for k in keys:
        del dic[k]
    return dic
##########################################################################
# The inputs to this node will be stored as a list in the IN variables.
dataEnteringNode = IN

calcMode = IN[0]
elemDicts = IN[1]


# Place your code below this line

def calcFormula_each_WmSpecs(elemDicts, calcMode):
    calc_key = "실행_물량산출식" if calcMode=="실행" else "입찰_물량산출식"
    
    def calcFormula_dict(d):
        e = d["Elem"]
        postSymValDict = d["wms"]["Post_Sym_Val Dict"]
        Sym_Vals = list(zip(postSymValDict.Keys, list(map(str, postSymValDict.Values))))
        sortedSym_Vals = sorted(Sym_Vals, key=lambda x: len(x[0]), reverse=True)
        wmSpecss = d["wms"]["wmSpecs"]
        for i in wmSpecss:
            applyFormula = i[calc_key]
            if not applyFormula.startswith('_'):
                substFormula = applyFormula
                for x in sortedSym_Vals:
                    substFormula = substFormula.replace(*x)
                i["applyFormula"] = applyFormula
                i["substFormula"] = substFormula
                try:
                    i["Quantity"] = round(eval(substFormula.strip('=')),3)
                except:
                    i["Quantity"] = substFormula
            else:
                i["applyFormula"] = applyFormula
                i["substFormula"] = applyFormula
                i["Quantity"] = ""
        return d
    
    res = []
    for d in elemDicts:
        res.append(calcFormula_dict(d))
#        e = d["Elem"]
#        postSymValDict = d["wms"]["Post_Sym_Val Dict"]
#        Sym_Vals = list(zip(postSymValDict.Keys, list(map(str, postSymValDict.Values))))
#        sortedSym_Vals = sorted(Sym_Vals, key=lambda x: len(x[0]), reverse=True)
#        wmSpecss = d["wms"]["wmSpecs"]
#        for i in wmSpecss:
#            applyFormula = i[calc_key]
#            substFormula = applyFormula
#            for x in sortedSym_Vals:
#                substFormula = substFormula.replace(*x)
#            
#            i["applyFormula"] = applyFormula
#            i["substFormula"] = substFormula
#            if substFormula.startswith('_'):
#                i["Quantity"] = applyFormula
#            else:
#                try:
#                    i["Quantity"] = round(eval(substFormula.strip('=')),3)
#                except:
#                    i["Quantity"] = substFormula
    
    return res




# Assign your output to the OUT variable.
OUT = calcFormula_each_WmSpecs(elemDicts, calcMode)
# ----------------------------------------
code_block_33 = CodeBlock(i=부재_wm_별_산식에_의한_최종_계산) { i["wms"]["Post_Sym_Val Dict"]; }
code_block_34 = CodeBlock(i=code_block_33) { i[278]; }
code_block_35 = CodeBlock(i=flatten) { i[0]; }
python_script = Python(IN[0]=code_block_35)  # CPython3
# ---------- python_script.python (17 lines) ----------
# Load the Python Standard and DesignScript Libraries
import sys
import clr
clr.AddReference('ProtoGeometry')
from Autodesk.DesignScript.Geometry import *

clr.AddReference('RevitNodes')
import Revit
clr.ImportExtensions(Revit.Elements)

# The inputs to this node will be stored as a list in the IN variables.
dataEnteringNode = IN
e = IN[0]
# Place your code below this line

# Assign your output to the OUT variable.
OUT = str(type(e))
# ----------------------------------------
keys_2 = DesignScript.Builtin.Dictionary.Keys(dictionary=excel_data_dictionarization_3_0)
code_block_36 = CodeBlock(i=excel_data_dictionarization_3_0) { i["111_PRAYER ROOM"]; }
code_block_37 = CodeBlock { "Work Master Code"; "GaugeCode"; }
code_block_38 = CodeBlock()
# ---------- code_block_38.designscript (8 lines) ----------
[
    "Work Master Code" ,"GaugeCode" ,"Unit" ,"Work Category-L1"
    ,"Work Category-L2" ,"Work Category-L3" ,"Spec. 1- L4" ,"Spec. 2- L5"
    ,"Spec. 3- L6" ,"Spec. 4- L7" ,"Spec. 5- L8" ,"Spec. 6- L9"
    ,"Spec. 7- L10" ,"Spec. 8- L11" ,"BOQ Spec1" ,"BOQ Spec2" ,"BOQ Spec3"
    ,"BOQ Spec4" ,"BOQ Spec5" ,"BOQ Spec6" ,"BOQ Spec7" ,"BOQ Spec8" ,"BOQ Spec9"
    ,"Description" ,"입찰_물량산출식" ,"실행_물량산출식" ,"rIDX"
];
# ----------------------------------------
code_block_39 = CodeBlock(i=code_block_38) { i[6]; i[7]; }
code_block_40 = CodeBlock(i=부재_wm_별_산식에_의한_최종_계산, a=code_block_37.out0, b=code_block_37.out1, c=code_block_39.out0, d=code_block_39.out1)
# ---------- code_block_40.designscript (12 lines) ----------
[
i["wms"]["wmSpecs"][a],
i["wms"]["wmSpecs"][b],
i["wms"]["wmSpecs"][c],
i["wms"]["wmSpecs"][d],
i["wms"]["wmSpecs"]["Description"],
i["wms"]["wmSpecs"]["applyFormula"],
i["wms"]["wmSpecs"]["substFormula"],
i["wms"]["wmSpecs"]["Quantity"],
i["wms"]["wmSpecs"]["Unit"],
i["wms"]["wmSpecs"]["rIDX"]
];
# ----------------------------------------
transpose_2 = List.Transpose(lists=code_block_40@@L4)
transpose_3 = List.Transpose(lists=transpose_2@@L3)
code_block_41 = CodeBlock(i=transpose_3) { i[0]; }
count = List.Count(list=code_block_41)

# group: Pjt Information Extract
categories_3 = Categories("OST_ProjectInformation")
all_elements_of_category_3 = ElementsOfCategory(Category=categories_3)
firstItem_2 = List.FirstItem(list=all_elements_of_category_3)
code_block_42 = CodeBlock()
# ---------- code_block_42.designscript (4 lines) ----------
[
"Project Name",
"Building Name"
];
# ----------------------------------------
parameterByName = Parameter.ParameterByName(element=firstItem_2, name=code_block_42)
value = Parameter.Value(parameter=parameterByName)
parameters = Element.Parameters(element=firstItem_2)
hasValue = Parameter.HasValue(parameter=parameters)
filterByBoolMask_4 = List.FilterByBoolMask(list=parameters, mask=hasValue)
name = Parameter.Name(parameter=filterByBoolMask_4.in)
code_block_43 = CodeBlock(i=name) { i!="Category"; }
filterByBoolMask_5 = List.FilterByBoolMask(list=filterByBoolMask_4.in, mask=code_block_43)
value_2 = Parameter.Value(parameter=filterByBoolMask_5.in)
code_block_44 = CodeBlock(i=value_2) { i!=""; }
filterByBoolMask_6 = List.FilterByBoolMask(list=filterByBoolMask_5.in, mask=code_block_44)
name_2 = Parameter.Name(parameter=filterByBoolMask_6.in)
value_3 = Parameter.Value(parameter=filterByBoolMask_6.in)
byKeysValues_2 = DesignScript.Builtin.Dictionary.ByKeysValues(keys=name_2, values=value_3)
stringifyJSON_2 = Data.StringifyJSON(values=byKeysValues_2)
list_create_5 = List.Create(item0=name_2, item1=value_3)

building_name = CodeBlock(bdName=value) { bdName; }
code_block_45 = CodeBlock(i=부재_wm_별_산식에_의한_최종_계산) { i["wms"]["Family Type Name"]; }
addItemToFront = List.AddItemToFront(item=code_block_45@L1, list=code_block_41@@L3, lacing=Shortest)
BOQbyElement_HTML_part = Python(IN[0]=addItemToFront)  # CPython3
# ---------- BOQbyElement_HTML_part.python (59 lines) ----------
# Load the Python Standard and DesignScript Libraries
import sys
import clr
clr.AddReference('ProtoGeometry')
from Autodesk.DesignScript.Geometry import *

clr.AddReference('RevitNodes')
import Revit
clr.ImportExtensions(Revit.Elements)
from Revit import Elements

from itertools import chain
#################################Module For Functional Programing#############################################
from functools import reduce
curry = lambda f: lambda a,*args: f(a, *args) if (len(args)) else lambda *args: f(a, *args)

filter = curry(filter)
map = curry(map)
reduce = curry(reduce)

go = lambda *args: reduce(lambda a,f: f(a), args) ## 함수도 축약 가능 ##
##############################################################################################################
# The inputs to this node will be stored as a list in the IN variables.
dataEnteringNode = IN
grps = IN[0]
# Place your code below this line
def make_tr(row):
    preStr = "<tr>"
    postStr = "</tr>"
    rowStrs = list(map(lambda x: f"<td>{x}</td>", row))
    res = "\n".join([preStr]+rowStrs+[postStr])
    return res

def make_trs(rows):
    rowsStrs = list(map(make_tr, rows))
    res = "\n".join(rowsStrs)
    return res

def make_wholeTable(rows):
    preStr = "<table>"
    postStr = "</table>"
    trs = make_trs(rows)
    res = "\n".join([preStr, trs, postStr])
    return res

def transTo_tableForm(grp):
    chkbox_tagStr = '<input type="checkbox" id="chkbox" name="checks">'

    title = "<h5>"+grp.pop(0)+"</h5>"
    res = [title]
    res.append(make_trs(grp))
    
    return res
    
rows = list(map(transTo_tableForm, grps))


# Assign your output to the OUT variable.
OUT = make_wholeTable(rows)
# ----------------------------------------

# group: HTML Export
javascriptPart = Python()  # CPython3; unwired: IN[0], IN[1], IN[2]
# ---------- javascriptPart.python (59 lines) ----------
# Load the Python Standard and DesignScript Libraries
import sys
import clr
clr.AddReference('ProtoGeometry')
from Autodesk.DesignScript.Geometry import *

# The inputs to this node will be stored as a list in the IN variables.
dataEnteringNode = IN

# Place your code below this line
jsPart = '''
function hideAllPages() {
        document.querySelector("#home").style.fontWeight = "normal";
        document.querySelector("#homePage").style.display = "None";
        document.querySelector("#info").style.fontWeight = "normal";
        document.querySelector("#infoPage").style.display = "None";
        document.querySelector("#famType").style.fontWeight = "normal";
        document.querySelector("#famTypePage").style.display = "None";
        document.querySelector("#roomInfo").style.fontWeight = "normal";
        document.querySelector("#roomInfoPage").style.display = "None";
        document.querySelector("#roomInfoPage_chk").style.display = "None";
}

document.querySelector("#cat").onclick = function() {
	    let img = document.createElement("img");
	    img.setAttribute("src", "https://t4.ftcdn.net/jpg/05/62/99/31/360_F_562993122_e7pGkeY8yMfXJcRmclsoIjtOoVDDgIlh.jpg");
	    document.querySelector("#cat").style.display = "None";
	    img.setAttribute("style", "width:300px;margin-top:20px;")
	    document.body.append(img);
	};
document.querySelector("#home").onclick = function() {
        hideAllPages();
        document.querySelector("#home").style.fontWeight = "bolder";
        document.querySelector("#homePage").style.display = "inline";
	};
document.querySelector("#info").onclick = function() {
        hideAllPages();
        document.querySelector("#info").style.fontWeight = "bolder";
        document.querySelector("#infoPage").style.display = "inline";
	};
document.querySelector("#famType").onclick = function() {
        hideAllPages();
        document.querySelector("#famType").style.fontWeight = "bolder";
        document.querySelector("#famTypePage").style.display = "inline";
	};
document.querySelector("#roomInfo").onclick = function() {
        hideAllPages();
        document.querySelector("#roomInfo").style.fontWeight = "bolder";
        document.querySelector("#roomInfoPage").style.display = "inline";
	};
document.querySelector("#roomInfo_chk").onclick = function() {
        hideAllPages();
        document.querySelector("#roomInfo_chk").style.fontWeight = "bolder";
        document.querySelector("#roomInfoPage_chk").style.display = "inline";
	};
	
'''
# Assign your output to the OUT variable.
OUT = jsPart
# ----------------------------------------
cssPart = Python()  # CPython3; unwired: IN[0], IN[1], IN[2]
# ---------- cssPart.python (125 lines) ----------
# Load the Python Standard and DesignScript Libraries
import sys
import clr
clr.AddReference('ProtoGeometry')
from Autodesk.DesignScript.Geometry import *

# The inputs to this node will be stored as a list in the IN variables.
dataEnteringNode = IN

# Place your code below this line
cssPart = '''

/* style.css */
img {
 width : 25%;
 height: 25%; 
}

:root {
  --text-color: #f0f4f5;
  --background-color: #263343;
  --accent-color: orange;
  --icons-color: rgb(152, 187, 201);
  --bodybackground-color: lightgray;
}

th {
  text-align: center;
  padding-left: 30px;
}

td {
  padding-left: 40px;
  border-bottom : 1px solid gray;
  border-collapse : collapse;
}

body {
  margin: 0;
  background-color: var(--bodybackground-color);
  font-family: 'STIX Two Math';
} 

a {
  text-decoration: none;
  color: var(--text-color);
}

.navbar {
  display: flex;
  position: sticky;
  top: 0px; /* 도달했을때 고정시킬 위치 */
  justify-content: space-between;
  align-items: center;
  background-color: var(--background-color);
  padding: 8px 12px;
  font-family: 'STIX Two Math';
}

.navbar__logo i {
  color: var(--accent-color);
  padding-left: 0;
}

.navbar__menu {
  list-style: none;
  display: flex;
  margin: 0;
  padding-left: 0;
}

.navbar__menu li {
  padding: 8px 30px;
  color: var(--text-color);
}

.navbar__menu li:hover {
  background-color: var(--accent-color);
  border-radius: 3px;
}

.navbar__icons {
  list-style: none;
  display: flex;
  color: var(--icons-color);
  margin: 0;
  padding-left: 0;
}

.navbar__icons li {
  padding: 8px 12px;
  margin: 0;
}

#cat {
  display: block;
  }

#home {
  font-weight: bolder;
  }

#homePage {
  display: inline;
  }

#infoPage {
  display: None;
  }

#famTypePage {
  display: None;
  }

#roomInfoPage {
  display: None;
  }

#roomInfoPage_chk {
  display: None;
  }

'''
# Assign your output to the OUT variable.
OUT = cssPart
# ----------------------------------------
navHTML_Part = Python()  # CPython3; unwired: IN[0]
# ---------- navHTML_Part.python (50 lines) ----------
# Load the Python Standard and DesignScript Libraries
import sys
import clr
clr.AddReference('ProtoGeometry')
from Autodesk.DesignScript.Geometry import *

# The inputs to this node will be stored as a list in the IN variables.
dataEnteringNode = IN

# Place your code below this line
navPart = f"""

<nav class="navbar">

  <ul class="navbar__menu">
    <li id="home">Home</li>
  </ul>

</nav>

"""

##navPart = f"""
##
##<nav class="navbar">
##<!--
##  <div class="navbar__logo">
##    <i class="fas fa-blog"></i>
##    <a href=""></a>
##  </div>
##-->
##  <ul class="navbar__menu">
##    <li id="home"><a href="#"">Home</a></li>
##    <li id="info"><a href="#">Project Information</a></li>
##    <li id="famType"><a href="#">Used Family Types</a></li>
##    <li><a href="#">Grid & Elevation</a></li>
##    <li><a href="#">Bookings</a></li>
##  </ul>
##
##<!--
##  <ul class="navbar__icons">
##    <li><i class="fab fa-google"></i></li>
##    <li><i class="fab fa-slack"></i></li>
##  </ul>
##-->
##</nav>
##
##"""
# Assign your output to the OUT variable.
OUT = navPart
# ----------------------------------------
list_create_6 = List.Create(item0=BOQbyElement_HTML_part)
make_htmlStr = Python(IN[0]=javascriptPart, IN[1]=cssPart, IN[2]=navHTML_Part, IN[3]=building_name, IN[4]=list_create_6)  # CPython3
# ---------- make_htmlStr.python (61 lines) ----------
# Load the Python Standard and DesignScript Libraries
import sys
import clr
clr.AddReference('ProtoGeometry')
from Autodesk.DesignScript.Geometry import *

# The inputs to this node will be stored as a list in the IN variables.
dataEnteringNode = IN
jsPart = IN[0]
cssPart = IN[1]
navPart = IN[2]

pjtName = IN[3][0]
bdName = IN[3][1]
pages = IN[4]

homePage = pages[0]



# Place your code below this line
##folderPath_r = folderPath.replace('\\','\\\\')

htmlStr = f'''
<!DOCTYPE html>
<html lang="ko">

<head>
    <link rel="shortcut icon" href="#">
    <meta charset="UTF-8">
    <title>RVT Calculation Result</title>
    <style>
        {cssPart}
    </style>
</head>

<header>
<h5>Revit Modeling Information Summary Page</h5>
<h4>{pjtName}</h4>
<h4>{bdName}</h4>
</header>

<body>
{navPart}

<div id="homePage">
{homePage}
</div>



<button id="cat">귀여운 고양이를 보기 버튼</button><br>

<script type ="module" src="./js/script.js"></script>

</body>

</html>
'''
# Assign your output to the OUT variable.
OUT = htmlStr
# ----------------------------------------
code_block_46 = CodeBlock(htmlStr=make_htmlStr) { htmlStr; }
serverFilePath = CodeBlock { ".dynTempServer"; }
htmlPath = Python(IN[0]=serverFilePath)  # CPython3
# ---------- htmlPath.python (34 lines) ----------
# Load the Python Standard and DesignScript Libraries
import sys
import clr
clr.AddReference('ProtoGeometry')
from Autodesk.DesignScript.Geometry import *
import time
import subprocess
import os

clr.AddReference('RevitNodes')
import Revit
clr.ImportExtensions(Revit.Elements)
from Revit import Elements
# The inputs to this node will be stored as a list in the IN variables.
dataEnteringNode = IN
dynTempServerPath = IN[0]
# Place your code below this line
def find_cwd():
    doc = Revit.Application.Document.Current
    filePath_string = doc.FilePath
    folderPath = filePath_string.split('\\')
    folderPath.pop(-1)
    folderPath_str = '\\'.join(folderPath)
    return folderPath_str

#cwd = find_cwd()
cwd = os.getenv("HomePath")

folderPath = f"{cwd}\\{dynTempServerPath}"
if not os.path.exists(folderPath):
    os.makedirs(folderPath)

# Assign your output to the OUT variable.
OUT = "C:"+folderPath
# ----------------------------------------
set_port_number_기본값_8000_작동_오류 = StringInput("8000")  # "Set Port Number: 기본값-8000 (작동 오류 없다면 변경 금지)"; graph input
create_html_file_and_open = Python(IN[0]=code_block_46, IN[1]=htmlPath, IN[2]=set_port_number_기본값_8000_작동_오류)  # CPython3
# ---------- create_html_file_and_open.python (85 lines) ----------
# Load the Python Standard and DesignScript Libraries
import os
import sys
import clr
clr.AddReference('ProtoGeometry')
from Autodesk.DesignScript.Geometry import *

clr.AddReference('RevitNodes')
import Revit
clr.ImportExtensions(Revit.Elements)
from Revit import Elements

import time
import subprocess
import asyncio
import multiprocessing

#################################Module For Functional Programing#############################################
from functools import reduce
curry = lambda f: lambda a,*args: f(a, *args) if (len(args)) else lambda *args: f(a, *args)

filter = curry(filter)
map = curry(map)

def _take(length, iter):
    res = []
    for a in iter:
        res.append(a)
        if len(res) == length:
            return res
        
take = curry(_take)
reduce = curry(reduce)

go = lambda *args: reduce(lambda a,f: f(a), args) ## 함수도 축약 가능 ##
##############################################################################################################

# The inputs to this node will be stored as a list in the IN variables.
dataEnteringNode = IN
contents = IN[0]
folderPath = IN[1]
cwd = folderPath
portNo = IN[2]
#bdName = IN[2]
# Place your code below this line

def find_cwd():
    doc = Revit.Application.Document.Current
    filePath_string = doc.FilePath
    folderPath = filePath_string.split('\\')
    folderPath.pop(-1)
    folderPath_str = '\\'.join(folderPath)
    return folderPath_str

def make_resultHTMLname(htmlStr,title,cwd):
    timeStamp = time.strftime('%H_%M_%S', time.localtime(time.time()))
    #folderPath = f"{cwd}\\.dynLog"
    folderPath = cwd
    if not os.path.exists(folderPath):
        os.makedirs(folderPath)
    fileName = f"index.html"
    filePath = f"{folderPath}\\" + fileName
    f = open(filePath, 'w', encoding='utf8')
    f.write(htmlStr)
    f.close()
    return fileName


def execute_browser(cwd):
    #cwd = find_cwd()
    folderPath = cwd
    os.chdir(folderPath)
    #cmdStr = "start chrome http:localhost:8000"
    cmdStr = f"start msedge http:localhost:{portNo}"
    cmdList= cmdStr.split(' ')
    #subprocess.run(args=[fileName], shell=True)
    #subprocess.run(args=['start','excel',fileName], shell=True)
    subprocess.run(args=cmdList, shell=True)
    return cmdList


fileName = make_resultHTMLname(contents,"test",cwd)

# Assign your output to the OUT variable.
OUT = execute_browser(cwd)#fileName.split('.')[0]
# ----------------------------------------
create_js_file = Python(IN[0]=javascriptPart, IN[1]=htmlPath)  # CPython3; unwired: IN[2]
# ---------- create_js_file.python (84 lines) ----------
# Load the Python Standard and DesignScript Libraries
import os
import sys
import clr
clr.AddReference('ProtoGeometry')
from Autodesk.DesignScript.Geometry import *

clr.AddReference('RevitNodes')
import Revit
clr.ImportExtensions(Revit.Elements)
from Revit import Elements

import time
import subprocess

#################################Module For Functional Programing#############################################
from functools import reduce
curry = lambda f: lambda a,*args: f(a, *args) if (len(args)) else lambda *args: f(a, *args)

filter = curry(filter)
map = curry(map)

def _take(length, iter):
    res = []
    for a in iter:
        res.append(a)
        if len(res) == length:
            return res
        
take = curry(_take)
reduce = curry(reduce)

go = lambda *args: reduce(lambda a,f: f(a), args) ## 함수도 축약 가능 ##
##############################################################################################################

# The inputs to this node will be stored as a list in the IN variables.
dataEnteringNode = IN
contents = IN[0]
folderPath = IN[1]
#bdName = IN[2]
# Place your code below this line
def find_cwd():
    doc = Revit.Application.Document.Current
    filePath_string = doc.FilePath
    folderPath = filePath_string.split('\\')
    folderPath.pop(-1)
    folderPath_str = '\\'.join(folderPath)
    return folderPath_str

#cwd = find_cwd()
cwd = folderPath

def make_resultHTMLname(jsStr,cwd):
    #timeStamp = time.strftime('%H_%M_%S', time.localtime(time.time()))
    #folderPath = f"{cwd}\\.dynLog"
    folderPath = cwd
    jsPath = cwd + "\\js"
    if not os.path.exists(folderPath):
        os.makedirs(folderPath)
    if not os.path.exists(jsPath):
        os.makedirs(jsPath)
    fileName = "script.js"
    filePath = f"{jsPath}\\" + fileName
    f = open(filePath, 'w', encoding='utf8')
    f.write(jsStr)
    f.close()
    return fileName

def execute_file(fileName):
    #cwd = find_cwd()
    folderPath = cwd
    os.chdir(folderPath)
    subprocess.run(args=[fileName], shell=True)
    #subprocess.run(args=['start','excel',fileName], shell=True)
    

fileName = make_resultHTMLname(contents,cwd)
#fileName = "Test1.html"

#execute_file(fileName)


# Assign your output to the OUT variable.
OUT = fileName
# ----------------------------------------
start_webserver = Python(IN[0]=htmlPath, IN[1]=set_port_number_기본값_8000_작동_오류)  # CPython3
# ---------- start_webserver.python (48 lines) ----------
# Load the Python Standard and DesignScript Libraries
import sys
import clr
clr.AddReference('ProtoGeometry')
from Autodesk.DesignScript.Geometry import *

import os
import asyncio
import multiprocessing
import subprocess
# The inputs to this node will be stored as a list in the IN variables.
dataEnteringNode = IN
cwd = IN[0]
portNo = IN[1]
# Place your code below this line
batStr = f"""
@echo on
python -m http.server {portNo}
cmd /k
"""
##cmd /k
title = "localWebserver"

def make_startSever_bat(batStr,title,cwd):
    folderPath = cwd
    if not os.path.exists(folderPath):
        os.makedirs(folderPath)
    fileName = f"{title}.bat"
    filePath = f"{folderPath}\\" + fileName
    f = open(filePath, 'w', encoding='utf8')
    f.write(batStr)
    f.close()
    return fileName

def startBat(fileName, cwd):
    cmdStr = f".\\{fileName}"
    cmdList= cmdStr.split(' ')
    os.chdir(cwd)
    
    res = subprocess.Popen(args=cmdList, shell=True)
    return res

batFileName = make_startSever_bat(batStr,title,cwd)
#res = multiprocessing.Process(name="SubProcess", target=startBat, args=(batFileName, cwd))
# Assign your output to the OUT variable.
OUT = startBat(batFileName, cwd)

#startBat(fileName, cwd)
# ----------------------------------------
make_htmlStr_2 = Python(IN[0]=javascriptPart, IN[1]=cssPart)  # CPython3; unwired: IN[2]
# ---------- make_htmlStr_2.python (53 lines) ----------
# Load the Python Standard and DesignScript Libraries
import sys
import clr
clr.AddReference('ProtoGeometry')
from Autodesk.DesignScript.Geometry import *

# The inputs to this node will be stored as a list in the IN variables.
dataEnteringNode = IN
jsPart = IN[0]
cssPart = IN[1]
tablePart = IN[2]

# Place your code below this line
##folderPath_r = folderPath.replace('\\','\\\\')

htmlStr = f'''
<!DOCTYPE html>
<html lang="ko">

<head>
    <meta charset="UTF-8">
    <title>my first three.js app</title>
    <style>
        {cssPart}
    </style>
</head>

<body>


<div class="wrapper">

  <a data-fslightbox="gallery" href="#custom-source">
    유튜브 라이트박스
  </a>

  <iframe id="custom-source"
          frameborder="0"
          width="1920px"
          height="1080px"
          allow="autoplay; fullscreen"
          src="https://www.youtube.com/embed/qgBSiRwsbNw?autoplay=1">
  </iframe>
</div>

<script src="https://cdnjs.cloudflare.com/ajax/libs/fslightbox/3.3.1/index.min.js" integrity="sha512-EqNNJuepkw5P9vxCml8eBk7C4Ld+4kAnvzOD/jG21rkxWPILGoQa5EvD62UieiJF0u3xoQrcVnce4i83VnYj/Q==" crossorigin="anonymous" referrerpolicy="no-referrer"></script>

</body>

</html>
'''
# Assign your output to the OUT variable.
OUT = htmlStr
# ----------------------------------------

flatten_2 = List.Flatten(list=addItemToFront@L2)
famType_HTML_part = Python(IN[0]=flatten_2)  # CPython3; frozen
# ---------- famType_HTML_part.python (64 lines) ----------
# Load the Python Standard and DesignScript Libraries
import sys
import clr
clr.AddReference('ProtoGeometry')
from Autodesk.DesignScript.Geometry import *

clr.AddReference('RevitNodes')
import Revit
clr.ImportExtensions(Revit.Elements)
from Revit import Elements

from itertools import chain
#################################Module For Functional Programing#############################################
from functools import reduce
curry = lambda f: lambda a,*args: f(a, *args) if (len(args)) else lambda *args: f(a, *args)

filter = curry(filter)
map = curry(map)
reduce = curry(reduce)

go = lambda *args: reduce(lambda a,f: f(a), args) ## 함수도 축약 가능 ##
##############################################################################################################
# The inputs to this node will be stored as a list in the IN variables.
dataEnteringNode = IN
grps = IN[0]
# Place your code below this line
def make_tr(row):
    preStr = "<tr>"
    postStr = "</tr>"
    rowStrs = list(map(lambda x: f"<td>{x}</td>", row))
    res = "\n".join([preStr]+rowStrs+[postStr])
    return res

def make_trs(rows):
    #rowsWithoutHdr = rows[0:]
    rowsStrs = list(map(make_tr, rows))
    res = "\n".join(rowsStrs)
    return res

def make_wholeTable(rows):
    preStr = "<table>"
    postStr = "</table>"
    trs = make_trs(rows)
    res = "\n".join([preStr, trs, postStr])
    return res

def transTo_tableForm(grp):
    chkbox_tagStr = '<input type="checkbox" id="chkbox" name="checks">'
    res_ = go\
    (
        grp,
        map(lambda x: [x, "", chkbox_tagStr]),
    )
    title = "<h2>"+grp.pop(0)+"</h2>"
    res = [[title,""]]
    for i in grp:
        res.append([i,chkbox_tagStr])
    
    return res
rows = grps #list(chain(*map(transTo_tableForm, grps)))


# Assign your output to the OUT variable.
OUT = make_wholeTable(rows)
# ----------------------------------------
watch = Watch(addItemToFront)  # graph output
code_block_47 = CodeBlock { "Area"; }
getParameterValueByName_6 = Element.GetParameterValueByName(element=code_block_6, parameterName=code_block_47)

# group: 심볼 및 값 추출
family_list데이터_revit_부재_데이터_결합 = Python(IN[0]=excel_data_dictionarization_3_0, IN[1]=code_block_6)  # "family list데이터 - Revit 부재 데이터 결합 & Sym_Val Dict 값 업데이트(타입,인스턴스 매개변수)"; CPython3; frozen
# ---------- family_list데이터_revit_부재_데이터_결합.python (116 lines) ----------
# Load the Python Standard and DesignScript Libraries
import sys
import clr

clr.AddReference('RevitAPI')
from Autodesk.Revit.DB import *
import Autodesk

#clr.AddReference('RevitNodes')
#import Revit
#clr.ImportExtensions(Revit.Elements)

clr.AddReference('RevitServices')
import RevitServices
from RevitServices.Persistence import DocumentManager
#doc = DocumentManager.Instance.CurrentDBDocument
#collector1 = FilteredElementCollector(doc)

clr.AddReference('ProtoGeometry')
from Autodesk.DesignScript.Geometry import *

################Module For Functional Programing##########################
from functools import reduce
from itertools import chain
from itertools import groupby
from copy import deepcopy
curry = lambda f: lambda a,*args: f(a, *args) if (len(args)) else lambda *args: f(a, *args)

filter = curry(filter)
map = curry(map)
reduce = curry(reduce)

go = lambda *args: reduce(lambda a,f: f(a), args) ## 함수도 축약 가능 ##

def dictUpdate(dic1,dic2):
    res = dic1.update(dic2)
    #res = {**dic1,**dic2}
    return dic1 #res
    
def dictsMerge(dics):
    res = reduce(dictUpdate, dics)
    return res
    
def dictDeleteKeys(dic, keys):
    for k in keys:
        del dic[k]
    return dic
##########################################################################

# The inputs to this node will be stored as a list in the IN variables.
dataEnteringNode = IN
famlist_dic = IN[0]
revitElems = IN[1]

# Place your code below this line
def matchWith_Elem_Dict(famlist_dic,revitElems):
    """
    레빗객체와 패밀리리스트 딕셔너리의 정보를 하나로 결합해주는 용도의 함수
    패밀리리스트 데이터는 패밀리 타입명을 키값으로 하는 하나의 딕셔너리로 정리되어있어야 한다
    revit객체는 패밀리리스트 상 존재하는 타입만 필터링해서 입력해야 함
    """
    # 수행결과를 모을 빈 리스트 선언
    res = []
    # 모든 레빗 객체들을 하나씩 순회 
    for i in revitElems:
        ## revit 객체들과 revit 타입별 Family List 딕셔너리를 결합하기 위한 빈 딕셔너리 선언
        combD = {}
        ## 패밀리 타입명 추출 - Room 객체인 경우와 아닌 경우 분기
        if "Room" in str(type(i)):
            famTypeName = i.GetParameterValueByName("Number") + "_" + i.GetParameterValueByName("Name")
        else:
            famTypeName = i.GetParameterValueByName("Type").GetParameterValueByName("Type Name")
        ## 결합용 딕셔너리의 "Elem" 이라는 키에 순회 중인 i (revit객체)를 할당
        combD["Elem"] = i
        ## 결합용 딕셔너리의 "wms" 이라는 키에 
        ## 순회 중인 i (revit객체) 패밀리 타입 명과 일치하는 famlist_dictionary의 값을 할당
        combD["wms"] = famlist_dic[famTypeName]
        ##결합된 딕셔너리를 res에 저장
        res.append(combD)
    # 전체 수행 결과 반환
    return res

def update_sym_valDict(matched_elemDicts):
    def update_sym_valDict_single(d):
        """
        딕셔너리별로 포함된 ["wms"]["Sym_Val Dict"]항목 내에
        아직 계산되지 않은 매개변수 값들을 계산하여
        "Post_Sym_Val Dict"라는 새로운 키의 값으로 할당하는 함수
        """
        e = d["Elem"]
        newSymValDict = {}
        keys = d["wms"]["Sym_Val Dict"].Keys
        vals = d["wms"]["Sym_Val Dict"].Values
        for s,v in zip(keys, vals):
            ## Vals 항목이 사용자 입력값이 아닌 revit 매개변수인 경우
            if isinstance(v,str):
                if v not in list(map(lambda x: x.Name, e.Parameters)):
                    calc_v = e.ElementType.GetParameterValueByName(v)
                else:
                    calc_v = e.GetParameterValueByName(v)
                calc_vv= calc_v if isinstance(calc_v, str) else round(calc_v, 3)
                newSymValDict[s] = calc_vv
            ## Vals 항목이 사용자 입력값인 경우는 그대로 입력된 숫자 사용
            else:
                newSymValDict[s] = v
        d["wms"]["Post_Sym_Val Dict"] = newSymValDict
        
        return d
    return list(map(update_sym_valDict_single, matched_elemDicts))


matched_elemDicts = matchWith_Elem_Dict(famlist_dic,revitElems)

# Assign your output to the OUT variable.

OUT = update_sym_valDict(matched_elemDicts)
# ----------------------------------------

code_block_48 = CodeBlock(i=family_list데이터_revit_부재_데이터_결합) { i; }
code_block_49 = CodeBlock(i=code_block_48) { i["wms"]["Family Type Name"]=="H_WA_AR_B07_Int Wall_Plaster T12"; }
filterByBoolMask_7 = List.FilterByBoolMask(list=code_block_48, mask=code_block_49)
code_block_50 = CodeBlock(i=filterByBoolMask_7.in) { i["Elem"]; }
code_block_51 = CodeBlock { "Area"; }
getParameterValueByName_7 = Element.GetParameterValueByName(element=code_block_50, parameterName=code_block_51)
code_block_52 = CodeBlock(i=filterByBoolMask_7.in) { i; }
