# Dynamo graph 공통(2)_Quantity Calculator_3.0.1_함수스플릿.dyn (Dynamo 2.16.1.2727)
# author: MK Jang
# Auto Calculating the Quantities of each Element As per the Family List

# group: All Data in Excel
family_list_경로_입력 = Filename("..\etc\물량산출테스트용\02_플랜트건축팀_BIM_팀 표준 Family List_Rev.3_2024.03.26_SLCB.xlsx")  # graph input
file_from_path = FileObject(path=family_list_경로_입력)
target_sheet_names = CodeBlock()
# ---------- target_sheet_names.designscript (18 lines) ----------
[
"WM-AR"
,"산출기준"
,"0.Room"
,"1.Floors"
,"2.Roofs"
,"3.Walls_Ext"
,"3.Walls_Int"
,"4.St_Fdn"
,"5.St_Col"
,"6.St_Framing"
,"7.Ceilings"
,"8.Doors"
,"9.Windows"
,"10.Stairs"
,"11.Railings"
,"12.Generic"
];
# ----------------------------------------
boolean = BoolSelector(true)
importExcel = Data.ImportExcel(file=file_from_path, sheetName=target_sheet_names, showExcel=boolean)

# group: Excel data dictionarization
lang_mode_영_한_select = BoolSelector(true)
excel_data_dictionarization = Python(IN[0]=lang_mode_영_한_select, IN[1]=importExcel, IN[2]=target_sheet_names)  # CPython3; frozen
# ---------- excel_data_dictionarization.python (215 lines) ----------
# Load the Python Standard and DesignScript Libraries
import sys
import clr
clr.AddReference('ProtoGeometry')
from Autodesk.DesignScript.Geometry import *

from functools import reduce
from functools import partial

# The inputs to this node will be stored as a list in the IN variables.
dataEnteringNode = IN
lang_mode = IN[0]
wholeDatas = IN[1]
db = wholeDatas[1:]
allCatSheetsNames = IN[2][2:]

paramSheet = db[0]
allCatSheets = db[1:]

#db
# Place your code below this line
def make_UnifiedDict(dictsList):
    dicts_AllInOne = {}
    for d in dictsList:
        dict_k_v = d.items()
        for k,v in dict_k_v:
            dicts_AllInOne[k] = v
    return dicts_AllInOne

def find_IsInStr(target, str):
    if target == None or str == None:
        pass
    else:
        res = target in str
        return res
def find_range_by_columnItem(db, col_idx, sep_rule):
    tdb = list(map(lambda x: x[col_idx], db))
    last_idx_tdb = len(tdb)-1
    tdb_enum = enumerate(tdb)
    res = list(filter(lambda x: find_IsInStr(sep_rule, x[1]), tdb_enum))
    endidxs_tmp= list(map(lambda x: x[0]-1,res))
    endidxs_tmp.pop(0)
    endidxs = endidxs_tmp + [last_idx_tdb]
    famTypeNames = list(map(lambda x: x[1],res))
    famTypeNamesIdxs = list(map(lambda x: x[0],res))
    rangeSttIdxs = list(map(lambda x: x[0]+1,res))
    rangeEndIdxs = endidxs
    result = dict(zip(famTypeNames, zip(famTypeNamesIdxs, zip(rangeSttIdxs,rangeEndIdxs))))
    return result
    
    
def find_headersAtSheet(sheet):
    headers_sheet = map(lambda x: [x[1].replace("\n",""),x[0]], filter(lambda x: x[1] != None, enumerate(sheet[1])))
    
    return dict(headers_sheet)

def find_rangesAtSheet(sheet, hdrs_withIdx, trgt_hdr, trgt_str):
    return find_range_by_columnItem(sheet, hdrs_withIdx[trgt_hdr], trgt_str)


def get_DataOnRangesAtParamSheet(sheet):
    
    hdrs_withIdx = find_headersAtSheet(sheet)
    rangesATSheet = find_rangesAtSheet(sheet, hdrs_withIdx, "Q'ty Cal Type Tag", "-")
    title_idx = map(lambda x: x[0], rangesATSheet.values())
    calcType_colDatas = list(map(lambda x: x[hdrs_withIdx["Q'ty Cal Type Tag"]], sheet))
    calcTypes = list(map(lambda x: calcType_colDatas[x], title_idx))
    rgs_v = list(map(lambda x: x[1], rangesATSheet.values()))
    rgs_k = list(map(lambda x: x, rangesATSheet.keys()))
    
    hdrs_v = list(hdrs_withIdx.values())
    hdrs_k = list(hdrs_withIdx.keys())
    eff_hdrs_v = hdrs_v[2:]
    eff_hdrs_k = hdrs_k[2:]
    
    datas_allCalType = list(map(lambda x: sheet[x[0]-1:x[1]], rgs_v))
    
    def setDict_OnEachCalType(data_calType):
        paramName_lang = "패밀리 매개변수(from Revit) 영문판" if lang_mode is True else "패밀리 매개변수(from Revit) 한글판"
        calcTypeName = data_calType[0][2]
        data_calType_noneless = list(filter(lambda x: x[hdrs_withIdx["항목"]] != None, data_calType))
#        ## WM row 별 header명 과 짝짓기
        data_withHdrsIdx = list(map(lambda y: list(map(lambda x: y[x], eff_hdrs_v)), data_calType_noneless))
        dict_ = list(map(lambda x: dict(zip(eff_hdrs_k, x)), data_withHdrsIdx))
        dicts_noneless = list(map(lambda y: dict(filter(lambda x: x[1]!=None, y.items())),dict_))
#        ## dict_Cal Type 입력처리
        targetColName = "Q'ty Cal Type Tag"
        dicts_finalNoneless = []
        for d in dicts_noneless:
            d["Q'ty Cal Type Tag"] = calcTypeName
            
            if "입력값" in d.keys():
                d["applyForCalc"] = d["입력값"]
                dicts_finalNoneless.append(d)
            elif paramName_lang in d.keys():
                d["applyForCalc"] = d[paramName_lang]
                dicts_finalNoneless.append(d)
            else:
                pass
        
        return {calcTypeName: dicts_finalNoneless}
        
    return map(setDict_OnEachCalType, datas_allCalType)
    


def get_SymValDict_PerCalcType(dic):
    def findDictPerCalcType(dicList):
            dic = {}
            for i in dicList:
                dic[i["산출수식 약자"]] = i["applyForCalc"]
            return dic
    
    ks_forDic = list(dic.keys())
    vs_forDic = list(map(findDictPerCalcType, dic.values()))
    res = dict(zip(ks_forDic, vs_forDic))
    return res


def get_DataOnRangesAtCatSheet(catSheet):
    hdrs_withIdx = find_headersAtSheet(catSheet)
    rangesATSheet = find_rangesAtSheet(catSheet, hdrs_withIdx, "Family Type Name", "H_")
    title_idx = map(lambda x: x[0], rangesATSheet.values())
    calcType_colDatas = list(map(lambda x: x[hdrs_withIdx["Q'ty Cal Type Tag"]], catSheet))
    calcTypes = list(map(lambda x: calcType_colDatas[x], title_idx))
    rgs_v = list(map(lambda x: x[1], rangesATSheet.values()))
    rgs_k = list(map(lambda x: x, rangesATSheet.keys()))
    
    hdrs_v = list(hdrs_withIdx.values())
    hdrs_k = list(hdrs_withIdx.keys())
    
    datas_allFamType = list(map(lambda x: list(zip(catSheet[x[0]-1:x[1]], range(x[0]-1,x[1]))), rgs_v))
    
    def setDict_OnEachFamType(data_famType):  ## 최종적으로 산출식 없는 것 걸러내기 추가해야 함
        titleData = list(data_famType).pop(0)[0]
        
        famTypeName = titleData[hdrs_withIdx["Family Type Name"]]
        calcTypeName = titleData[hdrs_withIdx["Q'ty Cal Type Tag"]]
        data_famType_noneless = list(filter(lambda x: x[0][5] != None, data_famType))
        ## WM row 별 header명 과 짝짓기
        data_withHdrsIdx = list(map(lambda y: [list(map(lambda x: y[0][x], hdrs_v)), y[1]], data_famType_noneless))
        hdrs_k.append("rIDX")
        dict_ = list(map(lambda x: dict(zip(hdrs_k, x[0]+[x[1]])), data_withHdrsIdx))
        dicts_noneless = list(map(lambda y: dict(filter(lambda x: x[1]!=None, y.items())),dict_))
        ## dict_gauge, 물량산출식 없는 항목 처리
        dicts_final = []
        needDefault_ColName = "Gauge Code"
        noneRemove_ColName = "Dynamo 물량산출식"
        for d in dicts_noneless:
            d["Family Type Name"] = famTypeName
            
            if calcTypeName == None:
                pass            
            elif noneRemove_ColName in d.keys():
                d["Q'ty Cal Type Tag"] = calcTypeName
                d[needDefault_ColName] = ""
                dicts_final.append(d)

        return dicts_final
        
    dicts_allFamType = list(map(lambda x: setDict_OnEachFamType(list(x)), datas_allFamType))
    ds_famTypesAtCatSheet = dict(zip(rgs_k, dicts_allFamType))
    ds_famTypesAtCatSheet_effCalcType = dict(filter(lambda x: all(list(map(lambda i: "Q'ty Cal Type Tag" in i, x[1]))), list(ds_famTypesAtCatSheet.items())))
    ds_famTypesAtCatSheet_noneless = dict(filter(lambda x: len(list(x[1]))!=0, list(ds_famTypesAtCatSheet_effCalcType.items())))
    
    return  ds_famTypesAtCatSheet_noneless

def make_AIOdic(allCatSheets):

    dataOnRanges_allCat = list(map(get_DataOnRangesAtCatSheet, allCatSheets))
    dataOnRanges_allCat_WithCatNames = list(zip(allCatSheetsNames, dataOnRanges_allCat))
    
    AIOdic = {}
    for d in dataOnRanges_allCat_WithCatNames:
        catName = d[0]
        dict_k_v = d[1].items()
        for k,v in dict_k_v:
            for wm in v:
                wm["SheetName"] = catName
            AIOdic[k] = v
    return AIOdic



def matchWith_paramDic(catSheetDic, paramSheetDic):
    headers = list(catSheetDic.values())[0][0].keys()
    wmspec_headers = list(filter(lambda x: "Work C" in x or "Spec" in x, headers))
    res = {}
    for famType,diclist in catSheetDic.items():
        new_diclist = []
        for d in diclist:
            new_d = {}
            keys = d.keys()
            keys_new = set(keys) - set(wmspec_headers)
            calcType = d["Q'ty Cal Type Tag"]
            new_d["Sym_Val Dict"] = paramSheetDic[calcType]
            new_d["wmSpecs"] = list(map(lambda x: d[x],wmspec_headers))
            for spec in keys_new:
                new_d[spec] = d[spec]
            new_diclist.append(new_d)
        
        res[famType] = new_diclist
        
    return res

calcTypeDictsList = get_DataOnRangesAtParamSheet(paramSheet)
calcTypeDict = make_UnifiedDict(calcTypeDictsList)
paramSheetDic = get_SymValDict_PerCalcType(calcTypeDict) 

catSheetDic = make_AIOdic(allCatSheets)
catFam_paramDic = matchWith_paramDic(catSheetDic, paramSheetDic)

# Assign your output to the OUT variable.

OUT = [catFam_paramDic,paramSheetDic, catSheetDic]
# ----------------------------------------
elemDicts = CodeBlock(i=excel_data_dictionarization) { i[0]; }
paramSheetDic = CodeBlock(i=excel_data_dictionarization) { i[1]; }
famTypeDic = CodeBlock(i=excel_data_dictionarization) { i[2]; }

# group: All Elements in Revit
all_elementsexceptrails = Python()  # CPython3; unwired: IN[0]
# ---------- all_elementsexceptrails.python (51 lines) ----------
# Load the Python Standard and DesignScript Libraries
import sys
import clr
clr.AddReference('ProtoGeometry')
from Autodesk.DesignScript.Geometry import *

clr.AddReference('RevitAPI')
from Autodesk.Revit.DB import *
import Autodesk

clr.AddReference('RevitServices')
import RevitServices
from RevitServices.Persistence import DocumentManager
doc = DocumentManager.Instance.CurrentDBDocument

def get_all_BIC():

    db = [
    Autodesk.Revit.DB.BuiltInCategory.OST_Floors,
    Autodesk.Revit.DB.BuiltInCategory.OST_Roofs,
    Autodesk.Revit.DB.BuiltInCategory.OST_Walls,
    Autodesk.Revit.DB.BuiltInCategory.OST_StructuralFoundation,
    Autodesk.Revit.DB.BuiltInCategory.OST_StructuralColumns,
    Autodesk.Revit.DB.BuiltInCategory.OST_StructuralFraming,
    Autodesk.Revit.DB.BuiltInCategory.OST_Ceilings,
    Autodesk.Revit.DB.BuiltInCategory.OST_Doors,
    Autodesk.Revit.DB.BuiltInCategory.OST_Windows,
    Autodesk.Revit.DB.BuiltInCategory.OST_Stairs,
    #Autodesk.Revit.DB.BuiltInCategory.OST_Railings,
    ]
    return db
    
def get_allElems(doc):
    bics = get_all_BIC()
    
    def getElems(x):
        collector = FilteredElementCollector(doc)
        res = collector.OfCategory(x).WhereElementIsNotElementType().ToElements()
        return res

    def getRailElems(x):
        collector = FilteredElementCollector(doc)
        res = collector.OfCategory(x).WhereElementIsNotElementType()
        return res

    res = map(getElems, bics)
#    res = getRailElems(Autodesk.Revit.DB.BuiltInCategory.OST_RailingSystemRail)
    return res


OUT = get_allElems(doc)
# ----------------------------------------
categories = Categories("OST_StairsRailing")
all_elements_of_category = ElementsOfCategory(Category=categories)
list_create = List.Create(item0=all_elements_of_category)
join = List.Join(list0=all_elementsexceptrails, list1=list_create)

# group: 필터링 구간 (패밀리 리스트에 없는 이름 제외)
flatten = List.Flatten(list=join)
code_block = CodeBlock { "Type"; "Type Name"; }
getParameterValueByName = Element.GetParameterValueByName(element=flatten, parameterName=code_block.out0)
keys = DesignScript.Builtin.Dictionary.Keys(dictionary=elemDicts)
getParameterValueByName_2 = Element.GetParameterValueByName(element=getParameterValueByName, parameterName=code_block.out1)
contains = List.Contains(list=keys, item=getParameterValueByName_2@L1)
filterByBoolMask = List.FilterByBoolMask(list=flatten, mask=contains)
code_block_2 = CodeBlock(filtered=filterByBoolMask.in) { filtered; }

# group: Family Type 별 WM 코드 Revit 되먹임
# note: Revit에 있는 Family Type 항목만
filterByBoolMask_2 = List.FilterByBoolMask(list=getParameterValueByName, mask=contains)
uniqueItems = List.UniqueItems(list=filterByBoolMask_2.in)
code_block_3 = CodeBlock(catSheetDatas=elemDicts, UniqElemTypes=uniqueItems) { catSheetDatas; UniqElemTypes; }
code_block_4 = CodeBlock { "Type"; "Type Name"; }
getParameterValueByName_3 = Element.GetParameterValueByName(element=code_block_3.UniqElemTypes, parameterName=code_block_4.out1)
valueAtKey = DesignScript.Builtin.Dictionary.ValueAtKey(dictionary=code_block_3.catSheetDatas, key=getParameterValueByName_3)
byKeysValues = DesignScript.Builtin.Dictionary.ByKeysValues(keys=getParameterValueByName_3, values=valueAtKey)
code_block_5 = CodeBlock { "Q'ty Cal Type Tag"; }
get_WMCodesAndBriefSpec = Python(IN[0]=byKeysValues, IN[1]=code_block_5)  # CPython3
# ---------- get_WMCodesAndBriefSpec.python (33 lines) ----------
# Load the Python Standard and DesignScript Libraries
import sys
import clr
clr.AddReference('ProtoGeometry')
from Autodesk.DesignScript.Geometry import *

# The inputs to this node will be stored as a list in the IN variables.
dataEnteringNode = IN
dict_aio = IN[0]
calType_header = IN[1]
# Place your code below this line
famTypes = list(dict_aio.items())
res_dict = {}


def find_WMspecsPerFamType(k_v):
    k = k_v[0]
    wms = k_v[1]
    res = list(map(lambda x: [x["Work Master Code"]] + x["wmSpecs"], wms))
    res_zeroless = list(map(lambda y: filter(lambda x: x!=0, y), res))
    joined_strs = list(map(lambda x: ' | '.join(x),res_zeroless))

    return k,joined_strs

WMspecs = list(map(find_WMspecsPerFamType, famTypes))

for k,v in WMspecs:
    res_dict[k] = [dict_aio[k][0][calType_header]] + v



# Assign your output to the OUT variable.
OUT = res_dict
# ----------------------------------------
valueAtKey_2 = DesignScript.Builtin.Dictionary.ValueAtKey(dictionary=get_WMCodesAndBriefSpec, key=getParameterValueByName_3)
code_block_6 = CodeBlock()
# ---------- code_block_6.designscript (12 lines) ----------
[
"H_Q'ty Cal Type Tag",
"H_WM Code_1",
"H_WM Code_2",
"H_WM Code_3",
"H_WM Code_4",
"H_WM Code_5",
"H_WM Code_6",
"H_WM Code_7",
"H_WM Code_8",
"H_WM Code_9"
];
# ----------------------------------------
setParamElementTypes = Python(IN[0]=code_block_3.UniqElemTypes, IN[1]=valueAtKey_2, IN[2]=code_block_6)  # CPython3; frozen
# ---------- setParamElementTypes.python (36 lines) ----------
# Load the Python Standard and DesignScript Libraries
import sys
import clr
clr.AddReference('ProtoGeometry')
from Autodesk.DesignScript.Geometry import *

clr.AddReference("RevitNodes")
import Revit
from Revit.Elements import *

# The inputs to this node will be stored as a list in the IN variables.
dataEnteringNode = IN
elemTypes = IN[0]
WMs_perFamTyp = IN[1]
param_ListForWM = IN[2]

input_sets = list(zip(elemTypes, WMs_perFamTyp))

# Place your code below this line

def setParamAnElem(elem, paramNames, paramVals):
    effName_List = paramNames[:len(paramVals)]
    effVals_List = paramVals
    setForParam = list(zip(effName_List, effVals_List))
    res = list(map(lambda x: elem.SetParameterByName(x[0],x[1]), setForParam))
    
    return res


final = map(lambda x: setParamAnElem(x[0],param_ListForWM,x[1]), input_sets)


#res = elemT.GetParameterValueByName("Default Thickness")
# Assign your output to the OUT variable.
#OUT = input_sets
OUT = final
# ----------------------------------------

code_block_7 = CodeBlock(file_path=family_list_경로_입력) { file_path; }
code_block_8 = CodeBlock(file_path=code_block_7) { file_path; }

# group: 기준 그라운드레벨 선택
categories_2 = Categories("OST_Levels")
all_elements_of_category_2 = ElementsOfCategory(Category=categories_2)
name = Level.Name(level=all_elements_of_category_2)
code_block_9 = CodeBlock { "G.L"; }
contains_2 = String.Contains(string=name, searchFor=code_block_9)
filterByBoolMask_3 = List.FilterByBoolMask(list=all_elements_of_category_2, mask=contains_2)
firstItem = List.FirstItem(list=filterByBoolMask_3.in)
elevation = Level.Elevation(level=firstItem)

# group: 심볼 및 값 추출(토공 포함) / 수식계산 / 익스포트 용 데이터 정리
토공_산출_모드_선택 = CustomSelection("개별 터파기", items={개별 터파기: "0", 온통 터파기: "1"})  # graph input
code_block_10 = CodeBlock(earthWork_calcMode=토공_산출_모드_선택) { earthWork_calcMode; }
family_list데이터_revit_부재_데이터_결합 = Python(IN[0]=elemDicts, IN[1]=code_block_2)  # "family list데이터 - Revit 부재 데이터 결합 & Sym_Val Dict 값 업데이트(타입,인스턴스 매개변수)"; CPython3
# ---------- family_list데이터_revit_부재_데이터_결합.python (102 lines) ----------
# Load the Python Standard and DesignScript Libraries
import sys
import clr

clr.AddReference('RevitAPI')
from Autodesk.Revit.DB import *
import Autodesk

#clr.AddReference('RevitNodes')
#import Revit
#clr.ImportExtensions(Revit.Elements)

clr.AddReference('RevitServices')
import RevitServices
from RevitServices.Persistence import DocumentManager
#doc = DocumentManager.Instance.CurrentDBDocument
#collector1 = FilteredElementCollector(doc)

clr.AddReference('ProtoGeometry')
from Autodesk.DesignScript.Geometry import *

from itertools import chain
from functools import reduce
from copy import deepcopy

# The inputs to this node will be stored as a list in the IN variables.
dataEnteringNode = IN
famlist_dic = IN[0]
revitElems = IN[1]

# Place your code below this line
def matchWith_Elem_Dict(famlist_dic,revitElems):
    res = []
    for i in revitElems:
        tmp = {}
        famTypeName = i.GetParameterValueByName("Type").GetParameterValueByName("Type Name")
        tmp["Elem"] = i
        tmp["wms"] = famlist_dic[famTypeName]
        
        res.append(tmp)
    return res

def update_sym_valDict(elemDicts):
    
    def make_newElemDict(elemDict):
        new_elemDict = {}
        elemDict_keys = elemDict.keys()
        elemDict_vals = list(elemDict.values())
        elemDict_items = list(elemDict.items())
        
        def get_newWMsWithcalculatedSymValSet(elemDict):
            elem = elemDict["Elem"]
            wms = elemDict["wms"]
            new_wms = []
            
            for wm in wms:
                new_wm ={}
                sym_valDict = wm["Sym_Val Dict"]
                wm_keys = wm.Keys
                wm_vals = wm.Values
                wm_items = list(zip(wm_keys,wm_vals))
                
                sv_keys = sym_valDict.Keys
                sv_vals = sym_valDict.Values
                sv_items = list(zip(sv_keys, sv_vals))
                sv_Dict = {}
                for k,v in sv_items:
                    if isinstance(v, str): ### 수정 필요 (굳이 v의 타입검사하는 이유?)
                        if v == "Level":
                            sv_Dict[k] = round(elem.GetParameterValueByName("Elevation at Bottom"),2)
                        elif elem.GetParameterValueByName(v):
                            sv_Dict[k] = elem.GetParameterValueByName(v)
                        elif elem.GetParameterValueByName("Type").GetParameterValueByName(v):
                            sv_Dict[k] = elem.GetParameterValueByName("Type").GetParameterValueByName(v)
                        else:
                            sv_Dict[k] = v
                    else:
                        sv_Dict[k] = v
                for k,v in wm_items:
                    if k == "Sym_Val Dict":
                        new_wm[k] = sv_Dict
                    else:
                        new_wm[k] = v
                new_wms.append(new_wm)
            return new_wms
                
                
        for k,v in elemDict_items:
            if k == "wms":
                new_elemDict[k] = get_newWMsWithcalculatedSymValSet(elemDict)
            else:
                new_elemDict[k] = v
                        
        return new_elemDict
    res = list(map(make_newElemDict, elemDicts))
    
    return res


# Assign your output to the OUT variable.

OUT = update_sym_valDict(matchWith_Elem_Dict(famlist_dic,revitElems))
# ----------------------------------------
# note: UG RC Union 준비(UG 부재 전체 형상 유니온 - PIT, Trench는 내부공동 포함하는 Boundary로)
# excavation 개별 형상 리스트
# 트레이에 하나 넣을 때마다,
# 처음은 그냥 두고,
# 두번째부터는 트레이에 있는 것과 겹치지 않는 부분만 남겨서 해당부분은 다음 코드로 반환 + 트레이 잔존
#     반환된 기초별 유효 터파기 형상을
#     UG RC Union이랑 디퍼런스 하면 백필형상
# 유표 터파기형상 볼륨 - 백필 형상 볼륨 = 디스포잘 값
dynamo_형상기반_별도_산출_구간_토공_etc = Python(IN[0]=code_block_10, IN[1]=family_list데이터_revit_부재_데이터_결합, IN[2]=elevation)  # "Dynamo 형상기반 별도 산출 구간(토공 + etc) 개별터파기"; CPython3
# ---------- dynamo_형상기반_별도_산출_구간_토공_etc.python (175 lines) ----------
# Load the Python Standard and DesignScript Libraries
import sys
import clr

clr.AddReference('RevitAPI')
from Autodesk.Revit.DB import *
import Autodesk

clr.AddReference('RevitNodes')
import Revit
clr.ImportExtensions(Revit.Elements)

clr.AddReference('RevitServices')
import RevitServices
from RevitServices.Persistence import DocumentManager
#doc = DocumentManager.Instance.CurrentDBDocument
#collector1 = FilteredElementCollector(doc)

clr.AddReference('ProtoGeometry')
from Autodesk.DesignScript.Geometry import *

from itertools import chain
from functools import reduce
import copy
###################################################################################################
curry = lambda f: lambda a,*args: f(a, *args) if (len(args)) else lambda *args: f(a, *args)

add = curry(lambda a,b: a + b)

filter = curry(filter)
map = curry(map)

def _take(length, iter):
    res = []
    for a in iter:
        res.append(a)
        if len(res) == length:
            return res
take = curry(_take)
reduce = curry(reduce)

go = lambda *args: reduce(lambda a,f: f(a), args) ## 함수도 축약 가능 ##
###########################################
# The inputs to this node will be stored as a list in the IN variables.
dataEnteringNode = IN
earthWork_calcMode = IN[0]
elemDicts = IN[1]
GL_zElev = IN[2]
Survey_Base_zGap = Revit.Elements.Coordinates.BasePoint().Z - Revit.Elements.Coordinates.SurveyPoint().Z
# Place your code below this line


def makeExcaShape(elem, sym_valDict, FL_GL_gap):
    def findBtmCrv(geo, sym_valDict): ##btmOffset = d1 + d2
        offSetDist = sym_valDict["D1"] + sym_valDict["D2"]
        h = abs(sym_valDict["C1"] + sym_valDict["C2"] + sym_valDict["C3"])
        bdBox_fdn = BoundingBox.ByGeometry(geo).ToCuboid() ## 형상의 자그마한 요철 무시
        srfs = bdBox_fdn.Explode() ## surface들
        btmSrf = PolySurface.ByJoinedSurfaces(list(filter(lambda x: round(x.NormalAtParameter(0.5,0.5).Z, 3) == -1, srfs)))
        btmCrvs = btmSrf.PerimeterCurves()
        btmPolCrv = PolyCurve.ByJoinedCurves(btmCrvs)
        offseted_btmPolCrv = btmPolCrv.Offset(offSetDist)
        #h_modified_btmPolCrv = offseted_btmPolCrv.Translate(0,0,-h-Survey_Base_zGap)
        h_modified_btmPolCrv = offseted_btmPolCrv.Translate(0,0,-h)
        return h_modified_btmPolCrv
    
    def findUprCrv(_btmPolCrv, sym_valDict):
        btmCrvZ = _btmPolCrv.StartPoint.Z
        #test = (sym_valDict["C1"] + sym_valDict["C2"] + sym_valDict["C3"])

        H = abs(round(btmCrvZ,2))
        G = sym_valDict["G"]
        offSetDist = (G * H)
        
        #uprPolCrv = _btmPolCrv.Translate(0,0,H).Offset(offSetDist)
        uprPolCrv = _btmPolCrv.Translate(0,0,H + Survey_Base_zGap -FL_GL_gap).Offset(offSetDist)
        #uprCrvZ = uprPolCrv.StartPoint.Z
        return uprPolCrv


    fdnsGeo = elem.Geometry()[0]
    btmPolCrv = findBtmCrv(fdnsGeo, sym_valDict)
    uprPolCrv = findUprCrv(btmPolCrv, sym_valDict)
    res = Solid.ByLoft([btmPolCrv,uprPolCrv])#.Translate(0,0, Survey_Base_zGap - FL_GL_gap)
    return res

    
def addExcaInElemDicts(elemDicts, FL_GL_gap):
    allExcas = []
    for idx,dic in enumerate(elemDicts):
        elem = dic["Elem"]
        wms = dic["wms"]
        excaBln = "Exca" in "".join(list(map(lambda x: x["Dynamo 물량산출식"], wms)))
        if excaBln:
            sym_valDict = wms[0]["Sym_Val Dict"]
            excaGeo = makeExcaShape(elem, sym_valDict, FL_GL_gap)
            try:
                allExcasUni = Solid.ByUnion(allExcas)
                eff_excaGeo = excaGeo.Split(allExcasUni)[0]
                allExcas.append(excaGeo)
            except:
                eff_excaGeo = excaGeo
                allExcas.append(excaGeo)
            dic["ExcaGeo"] = eff_excaGeo

    return elemDicts


def find_allGeo_UG_elems(elemDicts):
    geoResult = []
    for dic in elemDicts:
        elem = dic["Elem"]
        wms = dic["wms"]
        excaBln = "Exca" in "".join(list(map(lambda x: x["Dynamo 물량산출식"], wms)))
        famType_ = wms[0]["Family Type Name"]
            
        if "MAT_" in famType_ or "Mass_" in famType_ or "Pit" in famType_ or "Trench" in famType_:
            if "Slab" in famType_ or "MAT_" in famType_ or "Mass_" in famType_ : ## 내부 빈공간 있는 RC부재는 꽉채워서 공제 
                srfs = elem.Geometry()[0].Explode() ## surface들
                btmSrf = PolySurface.ByJoinedSurfaces(list(filter(lambda x: round(x.NormalAtParameter(0.5,0.5).Z, 3) == -1, srfs)))
                btmCrvs = btmSrf.PerimeterCurves()
                btmPolCrv = PolyCurve.ByJoinedCurves(btmCrvs)
                btmCrvZ = btmPolCrv.StartPoint.Z
                uprPolCrv = btmPolCrv.Translate(0,0,(0-btmCrvZ))
                targetGeo = Solid.ByLoft([btmPolCrv,uprPolCrv])
                geoResult.append(targetGeo)
            else:
                geoResult.append(elem.Geometry()[0])
        elif "PED_" in famType_ or "TG_" in famType_ or "SOG_" in famType_ or "UG" in famType_:
            geoResult.append(elem.Geometry()[0])
            
        elif excaBln:
            geoResult.append(elem.Geometry()[0])
            

    return geoResult


def add_effExcaInElemDicts(elemDicts):
    ## 서베이 포인트와 프로젝트 포인트의 Z값 차이로 인한 형상 높이 오류 수정값
    #surv_base_Gap = Revit.Elements.Coordinates.BasePoint().Z - Revit.Elements.Coordinates.SurveyPoint().Z
    FL_GL_gap = 0-GL_zElev
    allGeo_UG_RC_Elems = find_allGeo_UG_elems(elemDicts)
    allUniGeo_UG_RC_Elems = Solid.ByUnion(allGeo_UG_RC_Elems)
    elemDicts_excas = addExcaInElemDicts(elemDicts, FL_GL_gap)
    
    for dic in elemDicts_excas:
        if "ExcaGeo" in dic.keys():
            excaGeo = dic["ExcaGeo"]

            eff_excaGeo = excaGeo
            splitResult = eff_excaGeo.Split(allUniGeo_UG_RC_Elems)
            dic["effExcaGeo"] = eff_excaGeo
            dic["effBackfillGeo"] = splitResult[0]

        
        wms = dic["wms"]
        for wm in wms:
            if "Exca" in wm["Dynamo 물량산출식"] or\
               "Back" in wm["Dynamo 물량산출식"] or\
               "Disp" in wm["Dynamo 물량산출식"]:
                wm["Sym_Val Dict"]["Exca"] = dic["effExcaGeo"].Volume
                wm["Sym_Val Dict"]["Back"] = dic["effBackfillGeo"].Volume
                wm["Sym_Val Dict"]["Disp"] = dic["effExcaGeo"].Volume - dic["effBackfillGeo"].Volume



    return elemDicts_excas


# Assign your output to the OUT variable.
if earthWork_calcMode:
    OUT = 0
else:
    OUT = add_effExcaInElemDicts(elemDicts)
# ----------------------------------------
code_block_11 = CodeBlock(paramSheetDic=paramSheetDic) { paramSheetDic; }
# note: %터파기 형상은 바닥부재에서 비롯됨
# 1. 전체 터파기 형상 만들기
# 2. 전체 디스포잘 형상 만들기
# 3. 전체 터파기와 디스포잘 볼륨값을 각 "바닥 부재의 면적/전체터파기 참여 바닥 부재 면적합" 으로 분개하여 개별 터파기 및 개별 디스포잘 값 산출
# 4. 개별 터파기 - 개별 디스포잘 하여 개별 백필 물량 산출
wholeExca_CalcType = CodeBlock { "SF-Q0"; }
dynamo_형상기반_별도_산출_구간_토공_etc_ = Python(IN[0]=code_block_10, IN[1]=code_block_11, IN[2]=family_list데이터_revit_부재_데이터_결합, IN[3]=wholeExca_CalcType, IN[4]=elevation)  # "Dynamo 형상기반 별도 산출 구간(토공 + etc)_온통터파기"; CPython3
# ---------- dynamo_형상기반_별도_산출_구간_토공_etc_.python (200 lines) ----------
# Load the Python Standard and DesignScript Libraries
import sys
import clr

clr.AddReference('RevitAPI')
from Autodesk.Revit.DB import *
import Autodesk

clr.AddReference('RevitNodes')
import Revit
clr.ImportExtensions(Revit.Elements)

clr.AddReference('RevitServices')
import RevitServices
from RevitServices.Persistence import DocumentManager
#doc = DocumentManager.Instance.CurrentDBDocument
#collector1 = FilteredElementCollector(doc)

clr.AddReference('ProtoGeometry')
from Autodesk.DesignScript.Geometry import *

from itertools import chain
from functools import reduce
import copy
###################################################################################################
curry = lambda f: lambda a,*args: f(a, *args) if (len(args)) else lambda *args: f(a, *args)

add = curry(lambda a,b: a + b)

filter = curry(filter)
map = curry(map)

def _take(length, iter):
    res = []
    for a in iter:
        res.append(a)
        if len(res) == length:
            return res
take = curry(_take)
reduce = curry(reduce)

go = lambda *args: reduce(lambda a,f: f(a), args) ## 함수도 축약 가능 ##
###########################################
# The inputs to this node will be stored as a list in the IN variables.
dataEnteringNode = IN
earthWork_calcMode = IN[0]
paramSheetDic = IN[1]
elemDicts = IN[2]
wholeExca_CalcType = IN[3]
GL_zElev = IN[4]
Survey_Base_zGap = Revit.Elements.Coordinates.BasePoint().Z - Revit.Elements.Coordinates.SurveyPoint().Z
# Place your code below this line
def find_allGeo_UG_elems(elemDicts):
    geoResult = []
    for dic in elemDicts:
        elem = dic["Elem"]
        wms = dic["wms"]
        excaBln = "Exca" in "".join(list(map(lambda x: x["Dynamo 물량산출식"], wms)))
        famType_ = wms[0]["Family Type Name"]
            
        if "MAT_" in famType_ or "Mass_" in famType_ or "Pit" in famType_ or "Trench" in famType_:
            if "Slab" in famType_ or "MAT_" in famType_ or "Mass_" in famType_ : ## 내부 빈공간 있는 RC부재는 꽉채워서 공제 
                srfs = elem.Geometry()[0].Explode() ## surface들
                btmSrf = PolySurface.ByJoinedSurfaces(list(filter(lambda x: round(x.NormalAtParameter(0.5,0.5).Z, 3) == -1, srfs)))
                btmCrvs = btmSrf.PerimeterCurves()
                btmPolCrv = PolyCurve.ByJoinedCurves(btmCrvs)
                btmCrvZ = btmPolCrv.StartPoint.Z
                uprPolCrv = btmPolCrv.Translate(0,0,(0-btmCrvZ))
                targetGeo = Solid.ByLoft([btmPolCrv,uprPolCrv])
                geoResult.append(targetGeo)
            else:
                geoResult.append(elem.Geometry()[0])
        elif "PED_" in famType_ or "TG_" in famType_ or "SOG_" in famType_ or "UG" in famType_:
            geoResult.append(elem.Geometry()[0])
            
        elif excaBln:
            geoResult.append(elem.Geometry()[0])
            

    return geoResult

def makeExcaShape_whole(elemDicts, paramSheetDic, wholeExca_CalcType, FL_GL_gap):
    sym_valDict = paramSheetDic[wholeExca_CalcType]
    def findBtmCrv(geo, sym_valDict): ##btmOffset = d1 + d2
        offSetDist = sym_valDict["D1"] + sym_valDict["D2"]
        
        h = abs(sym_valDict["C1"] + sym_valDict["C2"] + sym_valDict["C3"])
        bdBox_fdn = BoundingBox.ByGeometry(geo).ToCuboid() ## 형상의 자그마한 요철 무시
        srfs = bdBox_fdn.Explode() ## surface들
        btmSrf = PolySurface.ByJoinedSurfaces(list(filter(lambda x: round(x.NormalAtParameter(0.5,0.5).Z, 3) == -1, srfs)))
        btmCrvs = btmSrf.PerimeterCurves()
        btmPolCrv = PolyCurve.ByJoinedCurves(btmCrvs)
        offseted_btmPolCrv = btmPolCrv.Offset(offSetDist)
        h_modified_btmPolCrv = offseted_btmPolCrv.Translate(0,0,-h)
        return h_modified_btmPolCrv
    
    def findUprCrv(_btmPolCrv, sym_valDict):
        btmCrvZ = _btmPolCrv.StartPoint.Z
        test = (sym_valDict["C1"] + sym_valDict["C2"] + sym_valDict["C3"])
        
        H = abs(round(btmCrvZ,2))
        G = sym_valDict["G"]
        offSetDist = (G * H)
        
        uprPolCrv = _btmPolCrv.Translate(0,0,H + Survey_Base_zGap -FL_GL_gap).Offset(offSetDist)
        uprCrvZ = uprPolCrv.StartPoint.Z
        return uprPolCrv
        
    def findExcaShapeByColFnds():
        all_ColFdnElems = list(map(lambda x: x["Elem"].Geometry()[0], filter(lambda dic: "ACF_W" in dic["wms"][0]["Family Type Name"], elemDicts)))
        resBdBox = BoundingBox.ByGeometry(all_ColFdnElems).ToCuboid()
        
        btmPolCrv = findBtmCrv(resBdBox, sym_valDict)
        uprPolCrv = findUprCrv(btmPolCrv, sym_valDict)
        res = Solid.ByLoft([btmPolCrv,uprPolCrv])#.Translate(0,0,FL_GL_gap)
        
        return res

    def findExcaShapeByMass():
        all_MassElems = list(map(lambda x: x["Elem"].Geometry()[0], filter(lambda dic: "ACE_Mass" in dic["wms"][0]["Family Type Name"], elemDicts)))
        if all_MassElems:
            resBdBox = BoundingBox.ByGeometry(all_MassElems).ToCuboid()
            btmPolCrv = findBtmCrv(resBdBox, sym_valDict)
            uprPolCrv = findUprCrv(btmPolCrv, sym_valDict)
            res = Solid.ByLoft([btmPolCrv,uprPolCrv])#.Translate(0,0,FL_GL_gap)
        else:
            res = []
        
        
        
        return res

    def findExcaShapeByPit():
        all_PitElems = list(map(lambda x: x["Elem"].Geometry()[0], filter(lambda dic: "ACP_Pit Slab" in dic["wms"][0]["Family Type Name"], elemDicts)))
        if all_PitElems:
            resBdBox = BoundingBox.ByGeometry(all_PitElems).ToCuboid()
            
            btmPolCrv = findBtmCrv(resBdBox, sym_valDict)
            uprPolCrv = findUprCrv(btmPolCrv, sym_valDict)
            res = Solid.ByLoft([btmPolCrv,uprPolCrv])#.Translate(0,0,FL_GL_gap)
        else:
            res = []
        return res
        
    finalTarget = list(filter(lambda x: x!=[] ,[findExcaShapeByColFnds(),findExcaShapeByMass(),findExcaShapeByPit()]))
    res = Solid.ByUnion(finalTarget)
    
    return res

def makeDispShape_whole(elemDicts, paramSheetDic, FL_GL_gap):
    total_ExcaGeo = makeExcaShape_whole(elemDicts, paramSheetDic, wholeExca_CalcType, FL_GL_gap)
    allGeo_UG_union = Solid.ByUnion(find_allGeo_UG_elems(elemDicts))
    dispShape = allGeo_UG_union.Split(total_ExcaGeo)[-1]
    backFillShape = total_ExcaGeo.Split(allGeo_UG_union)[0]
    return [dispShape, backFillShape]

def findBtmSrfs(geo):
    srfs = geo.Explode()
    btmSrf = PolySurface.ByJoinedSurfaces(list(filter(lambda x: round(x.NormalAtParameter(0.5,0.5).Z, 3) == -1, srfs)))
    return btmSrf
    
def calc_EarthWorkValue_InElemDicts(elemDicts, GL_zElev, paramSheetDic, wholeExca_CalcType):
    FL_GL_gap = 0 - GL_zElev
    allEarthRelatedElemsBtmSrfs = list(
        map(lambda x: findBtmSrfs(x["Elem"].Geometry()[0]), 
            filter(lambda dic: "ACF_W" in dic["wms"][0]["Family Type Name"] or \
                               "ACB_TG" in dic["wms"][0]["Family Type Name"] or \
                               "ACS_SOG" in dic["wms"][0]["Family Type Name"] or \
                               "ACE_Mass" in dic["wms"][0]["Family Type Name"] or \
                               "ACP_Pit Slab" in dic["wms"][0]["Family Type Name"], \
                elemDicts)))
    total_btmSrfsArea = sum(map(lambda x: x.Area, allEarthRelatedElemsBtmSrfs))
    total_Exca = makeExcaShape_whole(elemDicts, paramSheetDic, wholeExca_CalcType, FL_GL_gap)
    total_ExcaVolume = total_Exca.Volume
    total_Disp = makeDispShape_whole(elemDicts, paramSheetDic, FL_GL_gap)[0]
    total_DispVolume = total_Disp.Volume
    total_BackFill = makeDispShape_whole(elemDicts, paramSheetDic, FL_GL_gap)[1]
    total_BackFillVolume = total_BackFill.Volume
    
    for dic in elemDicts:
        elem = dic["Elem"]
        wms = dic["wms"]
        famType = wms[0]["Family Type Name"]
        for wm in wms:
            if "Exca" in wm["Dynamo 물량산출식"] or\
               "Back" in wm["Dynamo 물량산출식"] or\
               "Disp" in wm["Dynamo 물량산출식"] : ### 토공 산출 대상 부재에는 Exca Back Disp 세트로 포함하도록
                elem_btmSrfArea = findBtmSrfs(elem.Geometry()[0]).Area
                wm["Sym_Val Dict"]["Exca"] = total_ExcaVolume * (elem_btmSrfArea / total_btmSrfsArea)
                wm["Sym_Val Dict"]["Back"] = total_BackFillVolume * (elem_btmSrfArea / total_btmSrfsArea)
                wm["Sym_Val Dict"]["Disp"] = total_DispVolume * (elem_btmSrfArea / total_btmSrfsArea)
    
    return [elemDicts, [total_Exca, total_BackFill]]
# Assign your output to the OUT variable.
if earthWork_calcMode:
    OUT = calc_EarthWorkValue_InElemDicts(elemDicts, GL_zElev, paramSheetDic, wholeExca_CalcType)
else:
    OUT = [0,0]
    
#OUT = makeDispShape_whole(elemDicts, paramSheetDic)
# ----------------------------------------
elemDicts_2 = CodeBlock(i=dynamo_형상기반_별도_산출_구간_토공_etc_) { i[0]; }
부재_wm_별_산식에_의한_최종_계산 = Python(IN[0]=dynamo_형상기반_별도_산출_구간_토공_etc, IN[1]=elemDicts_2)  # CPython3
# ---------- 부재_wm_별_산식에_의한_최종_계산.python (98 lines) ----------
# Load the Python Standard and DesignScript Libraries
import sys
import clr

clr.AddReference('RevitAPI')
from Autodesk.Revit.DB import *
import Autodesk

clr.AddReference('RevitNodes')
import Revit
clr.ImportExtensions(Revit.Elements)

clr.AddReference('RevitServices')
import RevitServices
from RevitServices.Persistence import DocumentManager
from RevitServices.Transactions import TransactionManager
doc = DocumentManager.Instance.CurrentDBDocument
uiapp = DocumentManager.Instance.CurrentUIApplication
app = uiapp.Application
#collector1 = FilteredElementCollector(doc)

clr.AddReference('ProtoGeometry')
from Autodesk.DesignScript.Geometry import *

from itertools import chain
from functools import reduce
import copy
###################################################################################################
curry = lambda f: lambda a,*args: f(a, *args) if (len(args)) else lambda *args: f(a, *args)

add = curry(lambda a,b: a + b)

filter = curry(filter)
map = curry(map)

def _take(length, iter):
    res = []
    for a in iter:
        res.append(a)
        if len(res) == length:
            return res
take = curry(_take)
reduce = curry(reduce)

go = lambda *args: reduce(lambda a,f: f(a), args) ## 함수도 축약 가능 ##
###########################################
# The inputs to this node will be stored as a list in the IN variables.
dataEnteringNode = IN

elemDicts_eachEarth = IN[0]
elemDicts_wholeEarth = IN[1]

if elemDicts_eachEarth:
    elemDicts = elemDicts_eachEarth
else:
    elemDicts = elemDicts_wholeEarth

def clean_SymValDict(elemDicts):
    for dic in elemDicts:
        wms = dic["wms"]
        for wm in wms:
            formula = wm["Dynamo 물량산출식"]
            SymValDicts = wm["Sym_Val Dict"]
            SymValItems = list(zip(SymValDicts.Keys, SymValDicts.Values))
            sym_val_keySets = []
            sym_val_valSets = []
            for k,v in SymValItems:
                if k in formula:
                    sym_val_keySets.append(k)
                    sym_val_valSets.append(v)
            #wm["Sym_Val Set"] = [sym_val_keySets,sym_val_valSets]
            wm["Sym_Val Set"] = dict(zip(sym_val_keySets,sym_val_valSets))
            formula_eqSymRemove = formula.lstrip("=")
            tmp = formula_eqSymRemove
            for k in sym_val_keySets: ## 이 부분은 좀더 범용 처리 필요할수도
                priorSymList = ["Exca", "Back", "Disp"]
                #any(list(map(lambda x: x in tmp, priorList)))
                #if "Exca" in tmp or "Back" in tmp or "Disp" in tmp:
                if any(list(map(lambda x: x in tmp, priorSymList))):
                    appliedSym = list(filter(lambda x: x in tmp, priorSymList))[0]
                    #if len(k) > 1:
                    if k == appliedSym:
                        tmp = tmp.replace(k, str(wm["Sym_Val Set"][k]))
                else:
                    tmp = tmp.replace(k, str(wm["Sym_Val Set"][k]))
                
            
            #wm["calcResult"] = tmp.strip()
            wm["calcResult"] = round(eval(tmp.strip()),3)
    
    return elemDicts

# Place your code below this line

elemDicts_withSymValSet = clean_SymValDict(elemDicts)

# Assign your output to the OUT variable.
OUT = clean_SymValDict(elemDicts)
# ----------------------------------------
wm별_총합_계산_및_엑셀_익스포트_준비 = Python(IN[0]=부재_wm_별_산식에_의한_최종_계산)  # CPython3
# ---------- wm별_총합_계산_및_엑셀_익스포트_준비.python (71 lines) ----------
# Load the Python Standard and DesignScript Libraries
import sys
import clr
clr.AddReference('ProtoGeometry')
from Autodesk.DesignScript.Geometry import *

import operator
from itertools import groupby
import copy

# The inputs to this node will be stored as a list in the IN variables.
dataEnteringNode = IN
elemDicts = IN[0]
# Place your code below this line
def extractCalcResult(elemDicts):
    res = []
    for d in elemDicts:
        wms = d["wms"]
        for wm in wms:
            keys = ["SheetName", "rIDX", "Work Master Code", "Family Type Name", "calcResult"]
            vals = list(map(lambda x: wm[x],keys))
            k_v = list(zip(keys, vals))
            res.append(dict(k_v))
        
    return res


def make_dict_groupBy_Sheet_WM(elemDicts):
    extractedDicts = extractCalcResult(elemDicts)
    sortedDicts_sheet = sorted(extractedDicts, key=operator.itemgetter("SheetName"))
    grpDicts_Sheet = groupby(sortedDicts_sheet, lambda x: x["SheetName"])
    
    res = {}
    for k, g in grpDicts_Sheet:
        sorted_g = sorted(list(g), key=operator.itemgetter("rIDX"))
        grped_g = groupby(sorted_g, lambda x: x["rIDX"])
        tmp = []
        for k_,g_ in grped_g:
            gg = copy.deepcopy(list(g_))
            calcSum = round(sum(map(lambda x: x["calcResult"],gg)),3)
            rIDX = gg[0]["rIDX"]
            tmp.append((rIDX,calcSum))
            
        res[k] = tmp
    return res

def fill_dict_emptySlot(dic):
    tmp = []
    for k, v in dic.items():
#        for d in v:
#            all_idxs = list(map(lambda x: x[0],v))
#            max_idx = max(all_idxs)
#            full_range = range(0, max_idx+1)
        all_idxs = list(map(lambda x: x[0],v))
        max_idx = max(all_idxs)
        full_range = range(0, max_idx+1)
        
        for i in full_range:
            if i not in all_idxs:
                v.append([i, ""])
        tmp.append(sorted(v, key=operator.itemgetter(0)))
        
    res = list(zip(dic.keys(),tmp))
    return dict(res)



dict_groupBy_Sheet_WM = make_dict_groupBy_Sheet_WM(elemDicts)

# Assign your output to the OUT variable.
OUT = [fill_dict_emptySlot(dict_groupBy_Sheet_WM), elemDicts]
# ----------------------------------------
code_block_12 = CodeBlock(i=wm별_총합_계산_및_엑셀_익스포트_준비) { i[0]; i[1]; }
# note: Sym Val Dict에서
# 산출식에 사용된 것 이외를
# 제거하고 Sym-Val Set 딕셔너리로 저장하기
# note: Stair / Rails 등 추가 예정
totalEarthShape = CodeBlock(i=dynamo_형상기반_별도_산출_구간_토공_etc_) { i[1]; }

# group: Family List엑셀파일 물량 기입 구간
code_block_13 = CodeBlock(file_path=code_block_8) { file_path; }
components = DesignScript.Builtin.Dictionary.Components(dictionary=code_block_12.out0)
code_block_14 = CodeBlock { 6; 31; }
code_block_15 = CodeBlock { 1; }
getItemAtIndex = List.GetItemAtIndex(list=components.values@@L2, index=code_block_15)
dropItems = List.DropItems(list=getItemAtIndex@L2, amount=code_block_14.out0)
exportToExcel = Data.ExportToExcel(filePath=code_block_13, sheetName=components.keys@L1, startRow=code_block_14.out0, startColumn=code_block_14.out1, data=dropItems@L2)  # frozen

firstItem_2 = List.FirstItem(list=importExcel)
code_block_16 = CodeBlock(wm_sheetDatas=firstItem_2) { wm_sheetDatas; }
code_block_17 = CodeBlock(wm_sheetDatas=code_block_16) { wm_sheetDatas; }

# group: [WM-AR] 시트 데이터 정리
code_block_18 = CodeBlock(wm_sheetDatas=code_block_17) { wm_sheetDatas; }
code_block_19 = CodeBlock { 3; }
getItemAtIndex_2 = List.GetItemAtIndex(list=code_block_18@L2, index=code_block_19)
code_block_20 = CodeBlock { 6; }
dropItems_2 = List.DropItems(list=getItemAtIndex_2, amount=code_block_20)
uniqueItems_2 = List.UniqueItems(list=dropItems_2)
code_block_21 = CodeBlock(description판별항목1=uniqueItems_2) { description판별항목1; }
code_block_22 = CodeBlock { 5; }
getItemAtIndex_3 = List.GetItemAtIndex(list=code_block_18@L2, index=code_block_22)
code_block_23 = CodeBlock { 6; }
dropItems_3 = List.DropItems(list=getItemAtIndex_3, amount=code_block_23)
uniqueItems_3 = List.UniqueItems(list=dropItems_3)
code_block_24 = CodeBlock(description판별항목2=uniqueItems_3) { description판별항목2; }

code_block_25 = CodeBlock(famTypeDic=famTypeDic) { famTypeDic; }

# group: Total BOQ 엑셀파일 물량 기입 구간
total_boq_sheet_경로_입력 = Filename(".\Total BOQ_blank.xlsx")  # graph input
code_block_26 = CodeBlock { "(AR) BOQ"; "(AR) BOQ View (Working)"; false; }
code_block_27 = CodeBlock(filePath=total_boq_sheet_경로_입력, sheetName=code_block_26.out1) { filePath; sheetName; }
건물명_입력 = StringInput("Please enter Building Name before running ")  # graph input
list_create_2 = List.Create(item0=code_block_21, item1=code_block_24)
file_from_path_2 = FileObject(path=total_boq_sheet_경로_입력)
# note: Work Master Code
# Gauge Code
# Description : (L03)
# Spec. : (L04~L11)
# Additional Spec : (Description 항목 값)
importExcel_2 = Data.ImportExcel(file=file_from_path_2, sheetName=code_block_26.out1, showExcel=code_block_26.out2)
total_boq_데이터_파싱__ar_boq시트 = Python(IN[0]=건물명_입력, IN[1]=list_create_2, IN[2]=importExcel_2)  # CPython3
# ---------- total_boq_데이터_파싱__ar_boq시트.python (162 lines) ----------
# Load the Python Standard and DesignScript Libraries
import sys
import clr
clr.AddReference('ProtoGeometry')
from Autodesk.DesignScript.Geometry import *

from functools import reduce
from functools import partial
from string import ascii_lowercase
import itertools
from itertools import chain
import re
    
#################################Module For Functional Programing#############################################
curry = lambda f: lambda a,*args: f(a, *args) if (len(args)) else lambda *args: f(a, *args)

filter = curry(filter)
map = curry(map)

def _take(length, iter):
    res = []
    for a in iter:
        res.append(a)
        if len(res) == length:
            return res
        
take = curry(_take)
reduce = curry(reduce)

go = lambda *args: reduce(lambda a,f: f(a), args) ## 함수도 축약 가능 ##
##############################################################################################################
def find_IsInStr(target, str):
    if target == None or str == None:
        pass
    else:
        res = target in str
        return res
        
def find_IsInList(List, str):
    if str == None or List == None:
        pass
    else:
        res = str in List
        return res

def find_range_by_columnItem(db, col_idx, sep_rule):
    tdb = list(map(lambda x: x[col_idx], db))
    last_idx_tdb = len(tdb)-1
    tdb_enum = enumerate(tdb)
    res = list(filter(lambda x: find_IsInStr(sep_rule, x[1]), tdb_enum))
    endidxs_tmp= list(map(lambda x: x[0]-1,res))
    #endidxs_tmp= list(map(lambda x: x[0],res))
    endidxs_tmp.pop(0)
    endidxs = endidxs_tmp + [last_idx_tdb]
    famTypeNames = list(map(lambda x: x[1],res))
    famTypeNamesIdxs = list(map(lambda x: x[0],res))
    rangeSttIdxs = list(map(lambda x: x[0]+1,res))
    rangeEndIdxs = endidxs
    result = dict(zip(famTypeNames, zip(famTypeNamesIdxs, zip(rangeSttIdxs,rangeEndIdxs))))
    return result
    
def find_range_by_columnItem_discrim(db, col_idx, 판별항목):
    tdb = list(map(lambda x: x[col_idx], db))
    last_idx_tdb = len(tdb)-1
    tdb_enum = enumerate(tdb)
    res = list(filter(lambda x: find_IsInList(판별항목, x[1]), tdb_enum))
    endidxs_tmp= list(map(lambda x: x[0]-1,res))
    #endidxs_tmp= list(map(lambda x: x[0],res))
    endidxs_tmp.pop(0)
    endidxs = endidxs_tmp + [last_idx_tdb]
    famTypeNames = list(map(lambda x: x[1],res))
    famTypeNamesIdxs = list(map(lambda x: x[0],res))
    rangeSttIdxs = list(map(lambda x: x[0]+1,res))
    rangeEndIdxs = endidxs
    result = dict(zip(famTypeNames, zip(famTypeNamesIdxs, zip(rangeSttIdxs,rangeEndIdxs))))
    return result

# The inputs to this node will be stored as a list in the IN variables.
dataEnteringNode = IN
bd_name = IN[0]
descr판별항목 = IN[1]
판별항목lv1 = descr판별항목[0]
판별항목lv2 = descr판별항목[1]
db = IN[2]


# Place your code below this line
def Is_newSheet(Sheet):
    
    hdrs_withIdx = dict(list(find_headersAtSheet(Sheet).items()) + list(find_headers_Building(Sheet, bd_name).items()))
    datasOnWMCodeCol = list(map(lambda x: x[hdrs_withIdx["Work Master Code"]], Sheet))
    
    p = re.compile('\w{8}-\w{5}')
    IsNewSheet = not(any(list(map(lambda x: p.match(str(x)), datasOnWMCodeCol))))
    
    
    return [IsNewSheet,datasOnWMCodeCol]
    
def find_headersAtSheet(Sheet):
    headers_Sheet = map(lambda x: [x[1].replace("\n",""),x[0]], filter(lambda x: x[1] != None, enumerate(Sheet[2])))
    res = dict(headers_Sheet)
    #del res["_"]
    
    return res
    
def find_headers_Building(Sheet, bd_name):
    headers_bd = map(lambda x: [x[1].replace("\n",""),x[0]], filter(lambda x: x[1] != None, enumerate(Sheet[3])))
    headers_targetBD = list(filter(lambda x: x[0] == bd_name, headers_bd))
    res = {}
    res["targetBD"] = headers_targetBD[0][1]
    return res

def find_rangesAtSheet(Sheet, hdrs_withIdx, 판별항목):
    return find_range_by_columnItem_discrim(Sheet, hdrs_withIdx["Description"], 판별항목)

def get_DataOnRangesAtSheet(Sheet):
    
    hdrs_withIdx = dict(list(find_headersAtSheet(Sheet).items()) + list(find_headers_Building(Sheet, bd_name).items()))
    rgs_v_lv1 = list(map(lambda x: x[1], find_rangesAtSheet(Sheet, hdrs_withIdx, 판별항목lv1).values()))
    rgs_v_lv2 = list(map(lambda x: x[1], find_rangesAtSheet(Sheet, hdrs_withIdx, 판별항목lv2).values()))
    
    idxs_v_lv1 = list(map(lambda x: range(x[0],x[1]+1), rgs_v_lv1))

    datas_lv1 = []
    col_datas = list(map(lambda x: x[hdrs_withIdx["Description"]], Sheet))
    for rg in idxs_v_lv1:
        lv1_str = col_datas[rg[0]-1]
        tmp = []
        for i in rg:
            tmp.append([i, lv1_str, col_datas[i]])
        
        datas_lv1.append(tmp)

    datas_lv2 = []
    for rg in datas_lv1:
        tmp = []
        for idx,v in enumerate(rg):
            if v[2] == None:
                tmp.append([v[0],v[1],tmp[idx-1][2]])
            else:
                tmp.append(v)
        datas_lv2.append(tmp)

    flatten_res = list(chain(*datas_lv2))
    rres = itertools.groupby(flatten_res, lambda x: [x[1], x[2]])
    
    res = {}
    for k, g in rres:
        #print(list(g))
        removedfirstelem_g = list(g)[1:]
        res["_".join(k)] = [removedfirstelem_g[0][0],removedfirstelem_g[-1][0]]
        #res["_".join(k)] = removedfirstelem_g
    
    return res


hdrs_withIdx = dict(list(find_headersAtSheet(db).items()) + list(find_headers_Building(db, bd_name).items()))

if Is_newSheet(db)[0]:
    OUT = hdrs_withIdx, [Is_newSheet(db)[0],get_DataOnRangesAtSheet(db)]
else:
    OUT = hdrs_withIdx, Is_newSheet(db)
# ----------------------------------------
code_block_28 = CodeBlock(i=total_boq_데이터_파싱__ar_boq시트)
# ---------- code_block_28.designscript (3 lines) ----------
i[0];
i[1];
//구간 rIdx;
# ----------------------------------------
total_boq복사_및_경로_반환 = Python(IN[0]=code_block_27.filePath, IN[1]=code_block_28.out1)  # CPython3; frozen
# ---------- total_boq복사_및_경로_반환.python (35 lines) ----------
# Load the Python Standard and DesignScript Libraries
import sys
import clr
clr.AddReference('ProtoGeometry')
from Autodesk.DesignScript.Geometry import *
import datetime
import shutil

# The inputs to this node will be stored as a list in the IN variables.
dataEnteringNode = IN
origin_pathStr = IN[0]
IsNewSheet = IN[1][0]
# Place your code below this line

def copy_fromNewSheet():
    now = datetime.datetime.now()
    strList = origin_pathStr.split('.')
    
    add_str = now.strftime("%m%d-%I%M%S")
    add_res = "".join(["_",add_str,"."])
    strList.insert(1, add_res)
    res = "".join(strList)
    
    source = origin_pathStr
    destination = res
    shutil.copyfile(source, destination)
    
    return res

# Assign your output to the OUT variable.

if IsNewSheet:
    OUT = copy_fromNewSheet()
else:
    OUT = origin_pathStr
# ----------------------------------------
code_block_29 = CodeBlock(dict_groupBy_Sheet_WM=code_block_12.out1) { dict_groupBy_Sheet_WM; }
wm별_계산결과_및_spec_정리_from_element = Python(IN[0]=code_block_29)  # CPython3
# ---------- wm별_계산결과_및_spec_정리_from_element.python (69 lines) ----------
# Load the Python Standard and DesignScript Libraries
import sys
import clr
clr.AddReference('ProtoGeometry')
from Autodesk.DesignScript.Geometry import *

import operator
from itertools import groupby
import copy

# The inputs to this node will be stored as a list in the IN variables.
dataEnteringNode = IN
elemDicts = IN[0]
# Place your code below this line
def extractCalcResult(elemDicts):
    res = []
    for d in elemDicts:
        wms = d["wms"]
        for wm in wms:
            keys = ["SheetName", "rIDX", "Work Master Code", "Gauge Code", "wmSpecs", "Family Type Name", "calcResult"]
            vals = list(map(lambda x: wm[x],keys))
            k_v = list(zip(keys, vals))
            res_d = dict(k_v)
            if "Description" in wm.Keys:
                res_d["Description"] = wm["Description"]
            else:
                res_d["Description"] = ""
            res_d["wmcANDgauge"] = "".join([wm["Work Master Code"],wm["Gauge Code"]])
            res_d["UoM"] = wm["Unit"]
            res.append(res_d)
        
    return res

def make_dict_groupBy_WM(elemDicts):
    extractedDicts = extractCalcResult(elemDicts)
    sortedDicts_WMC = sorted(extractedDicts, key=operator.itemgetter("wmcANDgauge"))
    grpDicts_WMC = groupby(sortedDicts_WMC, key=operator.itemgetter("wmcANDgauge"))
    
    res = []
    for k, g in grpDicts_WMC: 
        wmCode = k
        gg = copy.deepcopy(list(g))
        calcSum = round(sum(map(lambda x: x["calcResult"], gg)),3)
        wmSpecs = gg[0]["wmSpecs"]
        catStr = "_".join([wmSpecs[0],wmSpecs[1]])
        specOnly = list(filter(lambda x: x!=0, wmSpecs))[3:]
        addSpec = gg[0]["Description"]
        dict_res = {
            "catStr": catStr,
            "Work Master Code": wmCode,
            "Gauge Code": gg[0]["Gauge Code"],
            "Description": wmSpecs[2],
            "Spec.": "\n".join(specOnly),
            "Additional Spec.": addSpec,
            "calcVal": calcSum,
            "UoM": gg[0]["UoM"]
            #"wmSpecs": wmSpecs,
            }
        res.append(dict_res)
    
    
    return res

extDicts = extractCalcResult(elemDicts)


# Assign your output to the OUT variable.
OUT = make_dict_groupBy_WM(elemDicts)
#OUT = sorted(set(map(lambda x: x["Work Master Code"], extDicts)))
# ----------------------------------------
wm별_spec_정리_from_family_list = Python(IN[0]=wm별_계산결과_및_spec_정리_from_element, IN[1]=code_block_25)  # CPython3
# ---------- wm별_spec_정리_from_family_list.python (136 lines) ----------
# Load the Python Standard and DesignScript Libraries
import sys
import clr
clr.AddReference('ProtoGeometry')
from Autodesk.DesignScript.Geometry import *

import operator
from itertools import groupby
from itertools import chain
import copy

# The inputs to this node will be stored as a list in the IN variables.
dataEnteringNode = IN
elemDicts = IN[0]
famTypeDict = IN[1]
wmDicts = list(chain(*famTypeDict.values()))
# Place your code below this line
def merge_dicts(*dict_args):
    """
    Given any number of dictionaries, shallow copy and merge into a new dict,
    precedence goes to key-value pairs in latter dictionaries.
    """
    result = {}
    for dictionary in dict_args:
        result.update(dictionary)
    return result

def getUnique_wmDicts(wmDicts):
    headers = wmDicts[0].Keys
    wmspec_headers = list(filter(lambda x: "Work C" in x or "Spec" in x, headers))
    noNeedKeys = ["Family Type Name", "Quantity", "rIDX", "Dynamo 물량산출식", "SheetName", "Q'ty Cal Type Tag"]
    def refineDicts(dicts, noNeedKeys):
        dicts_refined = []
        for d in dicts:
            new_d = {}
            keys,vals = d.Keys,d.Values
            keys_new = set(keys) - set(wmspec_headers)
            items = zip(keys, vals)  
            for k,v in items:
                if k not in noNeedKeys+wmspec_headers:
                    new_d[k] = v
                    new_d["wmSpecs"] = list(map(lambda x: d[x], wmspec_headers))
            dicts_refined.append(new_d)
        return dicts_refined
    wmDicts_refined = refineDicts(wmDicts, noNeedKeys)
        
    allWMcodes = list(map(lambda x: x["Work Master Code"], wmDicts_refined))
    uniqueWMcodes = set(allWMcodes)
    
    def getUnique(dicts, tgt_key):
        res = []
        tmp = []
        for d in dicts:
            if d[tgt_key] not in tmp:
                tmp.append(d[tgt_key])
                res.append(d)
        return res
    
    unique_wmDicts = getUnique(wmDicts_refined, "Work Master Code")

        
    return unique_wmDicts
    

    
def reformatDicts(wmDicts):
    res = []

    for wm in wmDicts:
        keys = ["Work Master Code", "Gauge Code", "wmSpecs"]
        vals = list(map(lambda x: wm[x],keys))
        items = list(zip(keys, vals))
        res_d = dict(items)
        
        if "Description" in wm.keys():
            res_d["Description"] = wm["Description"]
        else:
            res_d["Description"] = ""
        res_d["wmcANDgauge"] = "".join([wm["Work Master Code"],wm["Gauge Code"]])
        res_d["UoM"] = wm["Unit"]
        res.append(res_d)
        
    return res

def make_dict_groupBy_WM(wmDicts, elemDicts):
    unique_wmDicts = getUnique_wmDicts(wmDicts)
    reformated_dicts = reformatDicts(unique_wmDicts)
    sortedDicts_WMC = sorted(reformated_dicts, key=operator.itemgetter("wmcANDgauge"))
    grpDicts_WMC = groupby(sortedDicts_WMC, key=operator.itemgetter("wmcANDgauge"))
    
    wm_valDicts = {}
    for x in elemDicts:
        wm_valDicts[x["Work Master Code"]] = x["calcVal"]
    
    
    res = []
    for k, g in grpDicts_WMC: 
        wmCode = k
        gg = copy.deepcopy(list(g))
        wmSpecs = gg[0]["wmSpecs"]
        catStr = "_".join([wmSpecs[0],wmSpecs[1]])
        specOnly = list(filter(lambda x: x!=0, wmSpecs))[3:]
        addSpec = gg[0]["Description"]
        if wm_valDicts.get(k):
            dict_res = {
                "catStr": catStr,
                "Work Master Code": wmCode,
                "Gauge Code": gg[0]["Gauge Code"],
                "Description": wmSpecs[2],
                "Spec.": "\n".join(specOnly),
                "Additional Spec.": addSpec,
                "calcVal": wm_valDicts[k],
                "UoM": gg[0]["UoM"]
                #"wmSpecs": wmSpecs,
                }
        else:
            dict_res = {
                "catStr": catStr,
                "Work Master Code": wmCode,
                "Gauge Code": gg[0]["Gauge Code"],
                "Description": wmSpecs[2],
                "Spec.": "\n".join(specOnly),
                "Additional Spec.": addSpec,
                "calcVal": "",
                "UoM": gg[0]["UoM"]
                #"wmSpecs": wmSpecs,
                }
        res.append(dict_res)
    
    
    return res


# Assign your output to the OUT variable.
#OUT = make_dict_groupBy_WM(wmsList)
OUT = make_dict_groupBy_WM(wmDicts, elemDicts)
# ----------------------------------------
data_formatting_for_excel_export = Python(IN[0]=code_block_28.out1, IN[1]=wm별_spec_정리_from_family_list)  # CPython3
# ---------- data_formatting_for_excel_export.python (58 lines) ----------
# Load the Python Standard and DesignScript Libraries
import sys
import clr
clr.AddReference('ProtoGeometry')
from Autodesk.DesignScript.Geometry import *

from itertools import groupby
from itertools import chain

# The inputs to this node will be stored as a list in the IN variables.
dataEnteringNode = IN

IsNewSheet = IN[0][0]
inputDatas = IN[0][1]
wmsDicts = IN[1]
# Place your code below this line

def get_wmsGrped_sorted_idxed(rangeDicts, wmsDicts):
    wmsSorted = sorted(wmsDicts, key=lambda x: x["Work Master Code"])
    wmsGrped = groupby(wmsDicts, lambda x: x["catStr"])
    wmsGrped_sorted = []
    
    for k,v in wmsGrped:
        grp_sorted = sorted(list(v), key=lambda x: x["Work Master Code"])
        stt_idx = rangeDicts[k][0]
        length_grp = len(grp_sorted)
        idxs = range(stt_idx, stt_idx+length_grp)
        zip_grp_idxs = list(zip(idxs, grp_sorted))
        for i in zip_grp_idxs:
            d = i[1]
            d["rIDX"] = i[0]
        
        wmsGrped_sorted.append(grp_sorted)
        
    wmsGrped_sorted_idxed = list(chain(*wmsGrped_sorted))
    return wmsGrped_sorted_idxed

def match_DictWithIdx(datasOnWMCodeCol, wmsDicts):
    new_wmsDicts = []
    idxWithDatasOnWMCode = enumerate(datasOnWMCodeCol)
    for d in wmsDicts:
        if d["Work Master Code"] in datasOnWMCodeCol:
            d["rIDX"] = datasOnWMCodeCol.index(d["Work Master Code"])
            new_wmsDicts.append(d)
        else:
            pass
    #res = new_wmsDicts
    return new_wmsDicts

# Assign your output to the OUT variable.
if IsNewSheet:
    rangeDicts = inputDatas
    res = get_wmsGrped_sorted_idxed(rangeDicts, wmsDicts)
else:
    datasOnWMCodeCol = inputDatas
    res = filter(lambda x: x["calcVal"] != "", match_DictWithIdx(datasOnWMCodeCol, wmsDicts))

OUT = res
# ----------------------------------------
export_to_total_boq = Python(IN[0]=total_boq복사_및_경로_반환, IN[1]=code_block_27.sheetName, IN[2]=code_block_28.out0, IN[3]=code_block_28.out1, IN[4]=data_formatting_for_excel_export)  # CPython3; graph output; frozen
# ---------- export_to_total_boq.python (111 lines) ----------
# Load the Python Standard and DesignScript Libraries
import sys
import clr
clr.AddReference('ProtoGeometry')
from Autodesk.DesignScript.Geometry import *

from itertools import groupby

import DSOffice

# The inputs to this node will be stored as a list in the IN variables.
dataEnteringNode = IN
filePath = IN[0]
sheetName = IN[1]
hdrs_withIdx = IN[2]
IsNewSheet = IN[3][0]
dictList = IN[4]

# Place your code below this line
exportToExcel = DSOffice.Data.ExportToExcel
#print(hdrs_withIdx)

hdrsColIdxs = [
        hdrs_withIdx["Work Master Code"],
        hdrs_withIdx["Gauge Code"],
        hdrs_withIdx["Description"],
        hdrs_withIdx["Spec."],
        hdrs_withIdx["Additional Spec."],
        hdrs_withIdx["Reference to"],
        hdrs_withIdx["UoM"],
        hdrs_withIdx["targetBD"],
            ]

def writeToNewSheet(dictList):
    dictList_grped = groupby(dictList, lambda x: x["catStr"])
    
    dictList_grpedList = []
    for k,grp in dictList_grped:
        dictList_grpedList.append(list(grp))
    
    def writeExcel(keys, startColhdr, grpedList):
        for i in dictList_grpedList:
            #keys = ["Work Master Code", "Gauge Code", "Description", "Spec.", "Additional Spec.", ]
            startCol = hdrs_withIdx[startColhdr]
            startRow = i[0]["rIDX"]
    
            datas = list(zip(*map(lambda y: map(lambda x: x.get(y), list(i)), keys)))
            #res.append(datas)
            exportToExcel(filePath, sheetName, startRow, startCol, datas)
    
    #keys1 = ["Work Master Code", "Gauge Code", "Description", "Spec.", "Additional Spec.", ]
    keys1 = ["Work Master Code", "Gauge Code", "Description", "Spec.", "Additional Spec.", "Reference to", "UoM"]
    #keys2 = ["UoM"]
    keys3 = ["calcVal"]
    
    writeExcel(keys1,"Work Master Code", dictList_grpedList)
    #writeExcel(keys2,"UoM", dictList_grpedList)
    writeExcel(keys3,"targetBD", dictList_grpedList)
    
    return dictList_grpedList
    
def writeToExistSheet(dictList):
    dictList_grped = groupby(dictList, lambda x: x["catStr"])
    
    dictList_grpedList = []
    for k,grp in dictList_grped:
        dictList_grpedList.append(list(grp))
    
    def writeExcel_(keys,startColhdr, grpedList):
        #res = []
        for i in dictList_grpedList:
            #keys = ["Work Master Code", "Gauge Code", "Description", "Spec.", "Additional Spec.", ]
            startCol = hdrs_withIdx[startColhdr]
            startRow = i[0]["rIDX"]
    
            datas = list(zip(*map(lambda y: map(lambda x: x[y], list(i)), keys)))
            #res.append(datas)
            exportToExcel(filePath, sheetName, startRow, startCol, datas)
        #return res
        
    def writeExcel(key,startColhdr, dictList):
        all_rIDXs = list(map(lambda x: x["rIDX"], dictList))
        min_rIDX = min(all_rIDXs)
        max_rIDX = max(all_rIDXs)
        all_ranges = range(min_rIDX, max_rIDX+1)
        
        startCol = hdrs_withIdx[startColhdr]
        startRow = min_rIDX
        datas = []
        for i in all_ranges:
            if i in all_rIDXs:
                datas.append([dictList[all_rIDXs.index(i)][key]])
            else:
                datas.append([""])
        
        exportToExcel(filePath, sheetName, startRow, startCol, datas)
        
        #return datas
        
    key = "calcVal"
    
        
    writeExcel(key,"targetBD", dictList)
    
    return dictList_grpedList
# Assign your output to the OUT variable.

if IsNewSheet:
    OUT = writeToNewSheet(dictList)
else:
    OUT = writeToExistSheet(dictList)
# ----------------------------------------
code_block_30 = CodeBlock { "Steam Turbine Building"; "Gate House"; }

# group: 토공 형상 검토 및 DirectShape Revit 생성
custom_selection = CustomSelection("되메우기 형상", items={터파기 형상: "effExcaGeo", 되메우기 형상: "effBackfillGeo"})
categories_3 = Categories("OST_GenericModel")
토공_형상_검토 = Python(IN[0]=custom_selection, IN[1]=dynamo_형상기반_별도_산출_구간_토공_etc, IN[2]=totalEarthShape, IN[3]=categories_3)  # CPython3
# ---------- 토공_형상_검토.python (52 lines) ----------
# Load the Python Standard and DesignScript Libraries
import sys
import clr
clr.AddReference('ProtoGeometry')
from Autodesk.DesignScript.Geometry import *

clr.AddReference('RevitServices')
import RevitServices
from RevitServices.Persistence import DocumentManager
from RevitServices.Transactions import TransactionManager

import Revit

# The inputs to this node will be stored as a list in the IN variables.
dataEnteringNode = IN

tgt_key = IN[0]

elemDicts_eachEarth = IN[1]
shape_wholeEarth = IN[2]
directShapeCat = IN[3]

# Place your code below this line

def CreateDirectShapeByGeometry(geo, category):
    doc = DocumentManager.Instance.CurrentDBDocument
    uidoc=DocumentManager.Instance.CurrentUIApplication.ActiveUIDocument
    TransactionManager.Instance.EnsureInTransaction(doc)
    Revit.Elements.DirectShape.ByGeometry(geo, category)
    TransactionManager.Instance.TransactionTaskDone()

def createEarthWorkShape(tgt_key, elemDicts_eachEarth, shape_wholeEarth):
    dict_for_shape_wholeEarth = {
        "effExcaGeo": 0,
        "effBackfillGeo": 1
        }
    
    if shape_wholeEarth:
        res = shape_wholeEarth[dict_for_shape_wholeEarth[tgt_key]]
    else:
        onlyExcaDicts = list(filter(lambda x: tgt_key in x.keys(), elemDicts_eachEarth))
        res = Solid.ByUnion(list(map(lambda x: x[tgt_key], onlyExcaDicts)))
    return res



    
result = createEarthWorkShape(tgt_key, elemDicts_eachEarth, shape_wholeEarth)


# Assign your output to the OUT variable.
OUT = result#CreateDirectShapeByGeometry(res, directShapeCat)
# ----------------------------------------
byGeometry = DirectShape.ByGeometry(geometry=토공_형상_검토, category=categories_3)
color_palette = ColorPalette({R: 255, G: 20, B: 147, A: 255})
overrideColorInView = Element.OverrideColorInView(element=byGeometry, color=color_palette)

code_block_31 = CodeBlock()  # //레빗 프로젝트 단위 중 길이가 m 여야 한다
code_block_32 = CodeBlock(i=부재_wm_별_산식에_의한_최종_계산) { i; }  # frozen
code_block_33 = CodeBlock(i=code_block_32) { i["wms"]["Family Type Name"]=="H_FL_ACS_RC Slab_T180"; }
allTrue = List.AllTrue(list=code_block_33@@L2)
filterByBoolMask_4 = List.FilterByBoolMask(list=code_block_32, mask=allTrue)
watch = Watch(filterByBoolMask_4.in)
code_block_34 = CodeBlock(i=watch) { i["Elem"]; }
code_block_35 = CodeBlock { "Area"; }
getParameterValueByName_4 = Element.GetParameterValueByName(element=code_block_34, parameterName=code_block_35)
code_block_36 = CodeBlock(i=watch) { i["wms"]["Sym_Val Dict"]; }
watch_2 = Watch(dynamo_형상기반_별도_산출_구간_토공_etc)
필터링_구간_패밀리_리스트에_없는_이름_제외 = Python(IN[0]=flatten, IN[1]=elemDicts)  # CPython3; frozen
# ---------- 필터링_구간_패밀리_리스트에_없는_이름_제외.python (21 lines) ----------
# Load the Python Standard and DesignScript Libraries
import sys
import clr
clr.AddReference('ProtoGeometry')
from Autodesk.DesignScript.Geometry import *

# The inputs to this node will be stored as a list in the IN variables.
dataEnteringNode = IN
allRevitElemsFlatten = IN[0]
elemDicts = IN[1]
# Place your code below this line


def filterEffRevitElems(allRevitElemsFlatten, elemDicts):
    allFamTypesInExcel = elemDicts.keys()
    
    res = filter(lambda x: x.GetParameterValueByName("Type").GetParameterValueByName("Type Name") in allFamTypesInExcel, allRevitElemsFlatten)
    
    return res
# Assign your output to the OUT variable.
OUT = filterEffRevitElems(allRevitElemsFlatten, elemDicts)
# ----------------------------------------
excel_data_dictionarization_3_0 = Python(IN[0]=lang_mode_영_한_select, IN[1]=importExcel, IN[2]=target_sheet_names)  # "Excel data dictionarization_3.0.0"; CPython3; frozen
# ---------- excel_data_dictionarization_3_0.python (424 lines) ----------
# Load the Python Standard and DesignScript Libraries
import sys
import clr
clr.AddReference('ProtoGeometry')
from Autodesk.DesignScript.Geometry import *

#################################Module For Functional Programing#############################################
from functools import reduce
from itertools import chain
from itertools import groupby
from copy import deepcopy
curry = lambda f: lambda a,*args: f(a, *args) if (len(args)) else lambda *args: f(a, *args)

filter = curry(filter)
map = curry(map)
reduce = curry(reduce)

go = lambda *args: reduce(lambda a,f: f(a), args) ## 함수도 축약 가능 ##

def dictUpdate(dic1,dic2):
    res = dic1.update(dic2)
    #res = {**dic1,**dic2}
    return dic1 #res
    
def dictsMerge(dics):
    res = reduce(dictUpdate, dics)
    return res
    
def dictDeleteKeys(dic, keys):
    for k in keys:
        del dic[k]
    return dic
##############################################################################################################

import re
from functools import partial

# The inputs to this node will be stored as a list in the IN variables.
dataEnteringNode = IN
lang_mode = IN[0]
wholeDatas = IN[1]
db = wholeDatas[1:]
allCatSheetsNames = IN[2][2:]

calcStdSheet = db[0] ##산출기준 시트
allCatSheets = db[1:]


# Place your code below this line

def find_IsInStr(target, string):
    if target == None or string == None:
        pass
    else:
        res = str(target) in str(string)
        return res

def find_range_by_columnItem(db, col_idx, sep_rule):
    tdb = list(map(lambda x: x[col_idx], db)) ##targetTransposedDB (col_idx에 해당하는 데이터만 추출)
    last_idx_tdb = len(tdb)-1
    tdb_enum = enumerate(tdb)
    target_RowNumber = list(filter(lambda x: find_IsInStr(sep_rule, x[1]), tdb_enum))
    endidxs_tmp= list(map(lambda x: x[0]-1,target_RowNumber))
    endidxs_tmp.pop(0)
    endidxs = endidxs_tmp + [last_idx_tdb] ## 각 구간별 마지막 행 번호
    rangeSttIdxs = list(map(lambda x: x[0]+1,target_RowNumber))
    rangeEndIdxs = endidxs
    result = list(zip(rangeSttIdxs, rangeEndIdxs))
    return result

    
def find_headersAtSheet(sheet):
    headers_sheet = map(lambda x: [x[1].replace("\n",""),x[0]], filter(lambda x: x[1] != None, enumerate(sheet[1])))
    
    #return dict(headers_sheet)
    return list(headers_sheet)

def find_rangesAtSheet(sheet, hdrs_withIdx, trgt_hdr, trgt_str):
    hdrs_withIdxDict = dict(hdrs_withIdx)
    return find_range_by_columnItem(sheet, hdrs_withIdxDict[trgt_hdr], trgt_str)


def get_DataOnRowAreasAtSheet(sheet:list, discrHDRStr, discrRowStr):
    """
    판별기준 Header문자열(discrHDRStr)이 들어있는 열에서,
    판별기준 행 문자열(discrRowStr)이 들어있는 행번호 기준으로 구역을 나누어 데이터 리스트 반환
    """
    
    hdrs_withIdx = find_headersAtSheet(sheet)
    rowAreasAtSheet = find_rangesAtSheet(sheet, hdrs_withIdx, discrHDRStr, discrRowStr)
    typesTitle_idx = list(map(lambda x: x[0]-1, rowAreasAtSheet)) # 각 타입 명이 위치한 인덱스
    datas_perType = list(map(lambda x: sheet[x[0]-1:x[1]], rowAreasAtSheet))
    
    return (datas_perType, hdrs_withIdx)


def setDict_OnEachCalType(data_perType, hdrs_withIdx):
    """
    data_perType: '#' 등의 구분기호를 통해 나뉘어진 행 구간 내 전체 데이터_(행기준으로 구분된 형식)
    """
    hdrs_withIdxDict = dict(hdrs_withIdx)
    eff_hdrs_idx = list(zip(*hdrs_withIdx))[1]
    eff_hdrs_name = list(zip(*hdrs_withIdx))[0]
    calcTypeName = data_perType[0][hdrs_withIdxDict["Q'ty Cal Type Tag"]]

    paramDicts_withTypeName = go(
        data_perType,
        ## 엑셀 "항목" 열에 값이 없는 행 제외
        filter(lambda row: row[hdrs_withIdxDict["항목"]] != None), list,
        
        ## 모든 Null 값 빈문자열로 치환
        map(lambda row: list(map(lambda cell: cell if cell!=None else "",row))), list,

        ## 헤더에 해당하는 행 값을 추출--
        map(lambda row: list(map(lambda idx: row[idx], eff_hdrs_idx))), list,
        
        ## 헤더이름과 행 내부의 값을 2개씩 짝지어 줌
        map(lambda row: list(zip(eff_hdrs_name, row))), list,
        
        ## 헤더이름 : 값의 형태로 각 행 데이터를 딕셔너리로 만듬
        map(lambda x: dict(x)), list,
        
        ## "산출수식 약자" 키에 할당된 값이 빈문자열인 경우 제외
        filter(lambda d: d["산출수식 약자"]!=""), list,
        
        ## 딕셔너리에 "Q'ty Cal Type Tag" 키-값 추가
        map(lambda d: dictUpdate(d,{"Q'ty Cal Type Tag":calcTypeName})), list,
        
        ## 딕셔너리에 "applyForCalc" 키-값 추가
        ## ("수동 입력값"항목이 있는 경우에는 그값을 적용하고 아닌경우 "Parameter"항목 값
        map(lambda d: dictUpdate(d, { "applyForCalc":\
            d["수동 입력값"] if d["수동 입력값"] != "" \
            else d["Parameter"] if d["Parameter"] != "" \
            else 0 })), list,
        
        ## 타입이름을 키값으로 하는 중첩 딕셔너리 형성
        lambda x: {calcTypeName: x},
    )

    return paramDicts_withTypeName

###################################################################################################################
#!!! 함수가 너무 크다 쪼개자
#!!! setDict_OnEachFamType
#!!! -> setDict_EachRow_perGroup//setDict_stdWM_perGroup//setDict_applied_perGroup
###################################################################################################################
def setDict_OnEachFamType(data_perType, hdrs_withIdx, cat=None):
    """
    data_perType: '#' 등의 구분기호를 통해 나뉘어진 행 구간 내 전체 데이터_(행기준으로 구분된 형식)
    hdrs_withIdx: 헤더 명과 인덱스 번호가 순서대로 나열된 중첩 리스트
    cat : Room 시트 여부 판별용 입력값
    """
    hdrs_withIdxDict = dict(hdrs_withIdx)
    eff_hdrs_idx = list(zip(*hdrs_withIdx))[1]
    eff_hdrs_name = list(zip(*hdrs_withIdx))[0]
    # data_perType 에서, 타입 그룹 별로 "Q'ty Cal Type Tag" 열에 있는 값이
    # None일때가 있으므로 예외처리를 해주는 구간
    calcTypeName = data_perType[0][hdrs_withIdxDict["Q'ty Cal Type Tag"]] \
        if data_perType[0][hdrs_withIdxDict["Q'ty Cal Type Tag"]]!=None else "N/A"
    stdFamTypeNo = data_perType[0][hdrs_withIdxDict["NO"]]
    stdFamTypeName = data_perType[0][hdrs_withIdxDict["Standard Type"]]

    wmspec_headers = ["Work Master Code", "GaugeCode", "Unit"]\
        + list(filter(lambda x: "Work Cat" in x or "Spec" in x, eff_hdrs_name))\
        + ["Description","입찰_물량산출식", "실행_물량산출식"]
    
    # 그룹 안의 모든 행을 리스트에서 칼럼 명이 붙은 딕셔너리로 전환하는 구간
    # 실제 적용 패밀리 타입 및 각각 개별할당 WM 정리
    rowDicts = go(
        data_perType,
        ## 모든 Null 값 빈문자열로 치환
        map(lambda row: list(map(lambda cell: cell if cell!=None else "",row))), list,
        
        ## 헤더에 해당하는 행 내용을 추출
        map(lambda row: list(map(lambda idx: row[idx], eff_hdrs_idx))), list,
        
        ## 헤더이름과 행 내부의 값을 2개씩 짝지어 줌
        map(lambda row: list(zip(eff_hdrs_name, row))), list,        

        ## 헤더이름 : 값의 형태로 각 행 데이터를 딕셔너리로 만듬
        map(lambda x: dict(x)), list,
    )

    # 그룹 내의 모든 행딕셔너리 들 중 찾고자 하는 규칙에 따라 참거짓 여부를 반환하는 함
    def findRow_AppliedType(rowDict, tgtHDRname, rule=None):
        p = re.compile('[0-9]{3,5}')
        target = str(rowDict[tgtHDRname])
        ## 함수 호출시 구분자(rule) 없이 호출한 경우
        ## -Room Category 시트 용 이며 "Standard Type" 항목의 값이 000형태의 숫자인지를 판별
        ## -Room Category 중 "Standard Type" 칼럼에 룸 넘버, "Family Type Name" 칼럼에 룸 이름 입력하게 되어있음
        if rule==None:
            p = re.compile('[0-9]{3,5}')
            m = p.match(target)
            stdCase = target =="Room No"
            res = all([m or stdCase])
        ## 구분자(rule)가 정규표현식 객체로 들어온 경우
        elif isinstance(rule, re.Pattern):
            m = p.match(target)
            res = all([m])
        ## 구분자(rule)가 문자열로 들어온 경우
        else:
            res = rule in target
        return res
    
    # 그룹 내의 모든 행 딕셔너리 중, 개별 적용 패밀리명이 아닌 공통 WM 항목에 대한 정보 추출
    stdFamTypeInfo = go(
        rowDicts,
        ## 엑셀 "물량산출식", "Work Master Code" 열에 값이 없는 행 제외
        ## Family Type Name에 "H_" 문자열 포함된 경우 제외
        filter(lambda d: d["입찰_물량산출식"] != ""),
        filter(lambda d: d["실행_물량산출식"] != ""),
        filter(lambda d: d["Work Master Code"] != ""),
        filter( lambda d: \
            (not findRow_AppliedType(d, "Standard Type")) or (not findRow_AppliedType(d, "Standard Type", rule="H_")) \
            ### 룸카테고리인 경우는 "Standard Type"항목에 값이 숫자가 아니거나, "H_"문자열이 포함되지 않은 항목 추출
            if cat == "roomCat" else\
            ### 룸카테고리가 아닌 경우, "Family Type Name" 항목에 "H_"문자열 포함되지 않은 항목 추출 
            not findRow_AppliedType(d, "Family Type Name", rule="H_") ),
        list,
        
        # wmSpecs 속성들을 헤더로 하는 새로운 딕셔너리 형성 및 값 추가(값은 list형태)
        map( lambda d: \
            go(
                ### wmspec관련 항목들 값을 리스트로 모음
                map(lambda x: d[x], wmspec_headers), list,
                ### 항목명과 항목값을 모아서 딕셔너리 형태로 변환
                lambda x: zip(wmspec_headers,x), dict,
            )
        ),
        list,
    )
    
    def dictsUnion_withInnerKey(dicts:list,innerkey):
        """
        최상위 키값이 "하나"이고, 그 하위에 종속된 딕셔너리의 키구성이 동일한 복수의 딕셔너리 중 ,
        키 값이 동일한 것이 있을 때 딕셔너리별로 해당 키에 대응하는 값들을
        맨 처음의 딕셔너리로 값으로 재할당하고 해당 딕셔너리만 반환
        """
        # 최상위 키값을 기준으로 딕셔너리들 그루핑
        if len(dicts) != 0:
            groupedDicts = go(
                dicts,
                lambda col: sorted(col, key=lambda x:list(x.keys())),
                lambda col: groupby(col, lambda x: list(x.keys())),
                map(lambda x: list(map(lambda y: list(y), x))),
                list,
            )
            # 최상위 키값이 중복되는 딕셔너리를 모은 리스트
            plurals = list(map(lambda y: y[1], filter(lambda x: len(x[1])>1, groupedDicts)))
            # 최상위 키값이 다른 어떤 딕셔너리와 중복되지 않는 단일 개체들 모은 리스트
            singles = list(map(lambda y: y[1][0], filter(lambda x: len(x[1])==1, groupedDicts)))
            # 하부딕셔너리 구성키 전체
            #hdrs = list(dicts[0][list(dicts[0].keys())[0]].keys())
            
            # plurals 없는 경우 처리
            if len(plurals)==0:
                res = singles
            else:
                newPlurals = []
                for sameKeyGroup in plurals:
                    ### 최상단 키
                    titleKey = list(sameKeyGroup[0].keys())[0]
                    newD = deepcopy(sameKeyGroup[0])
                    newD[titleKey][innerkey]=[]
                    for d in sameKeyGroup:
                        newD[titleKey][innerkey].append(d[titleKey][innerkey][0])
                    newPlurals.append(newD)
                res = newPlurals + singles
        
            return res
        
    # 그룹 내의 모든 행 딕셔너리 중, 개별 적용 패밀리에 대한 정보 추출
    # 엑셀 시트에서 "Family Type Name" 칼럼의 값이 보라색으로 기입된 모든 행 대상
    actualAppliedFamTypeInfo = go( ##!!! 적용 패밀리 이름 동일한게 있을때 내용 합치는 구간 추가 필요
        rowDicts,
        ## Family Type Name 항목 중 "H_" 문자열이 포함된 개체만 필터링
        filter( lambda d: \
            findRow_AppliedType(d, "Standard Type") \
            if cat == "roomCat" else\
            findRow_AppliedType(d, "Family Type Name", rule="H_")
            ),
        
        ## 행 딕셔너리에 wmSpecs 속성 및 값 추가(값은 list형태)
        ##!!! 적용 패밀리 이름 동일한게 있을때 내용 합치는 구간 추가 필요 - 공통 WM 추가 코드는 분리 필요
        map( lambda d: dictUpdate(d, {"wmSpecs": \
            go(
                ### wmspec관련 항목들 값을 리스트로 모음
                map(lambda x: d[x], wmspec_headers), list,
                ### 항목명과 항목값을 모아서 딕셔너리 형태로 변환
                lambda x: zip(wmspec_headers,x), dict,
                
                ### wmSpecs 항목을 리스트 구조로 수정해 두기 & 개별 WM정보가 없는 경우는 리스트에서 제외
                #lambda x: [x] if x["Work Master Code"]!="" else [],
                ### stdFamType의 WM정보와 합치기 - 밖으로 분리 필요
                lambda x: [ *stdFamTypeInfo, x \
                    if x["Work Master Code"]!="" else ["No Individual WM information"] ],
                ### 개별 WM정보가 없는 경우는 리스트에서 제외
                filter(lambda x: isinstance(x,dict)), list,
            ) }) 
        ), list,
        
        ## 밖으로 꺼내진 WorkMaster 관련 속성 삭제
        map(lambda d: dictDeleteKeys(d, wmspec_headers)), list,
        
        ## 딕셔너리에 Q'ty Cal Type Tag 키에 값 업데이트
        map(lambda d: dictUpdate(d,{"Q'ty Cal Type Tag": calcTypeName})), list,
        
        ## 딕셔너리에 Standard Type키에 값 업데이트
        map( lambda d: dictUpdate(d,{"NO":d["Standard Type"], "Standard Type":stdFamTypeName})) \
            if cat=="roomCat" \
            else map(lambda d: dictUpdate(d,{"NO":stdFamTypeNo, "Standard Type":stdFamTypeName}) ), 
        list,
        
        ## 딕셔너리에 wmSpecs 내 "Work Master Code" 값을 GaugeCode 포함한 값으로 업데이트 (필요한가?)
        
        
        ## Family Type Name 문자열을 키값으로 하는 딕셔너리로 변형
        #map(lambda d: {d["Family Type Name"]:d}), list,
        map(lambda d: {f'{d["NO"]}'+"_"+d["Family Type Name"]:d})\
            if cat=="roomCat" \
            else map(lambda d: {d["Family Type Name"]:d}), list,
        
        ## 최상위 키가 1개인 딕셔너리들 중 최상위 키 값이 같은 딕셔너리 들만 "wmSpecs" 내용 합치기
        #lambda x: dictsUnion_withInnerKey(x, "wmSpecs"),
        
    )
    
    return eff_hdrs_idx#actualAppliedFamTypeInfo



def dataToDict(setDict_f, args, cat=None):
    (datas_perType, hdrs_withIdx) = args
    res = go(
        datas_perType,
        ## 
        map( lambda datas: \
            setDict_f(datas, hdrs_withIdx, cat=cat) if cat=="roomCat" \
            else setDict_f(datas, hdrs_withIdx)
        ),
            
        ## 빈 리스트라서 매치할 수 없는 개체 제외
        filter(lambda x: x!=[] and x!=None), list,
        
        ## 산출기준 시트와, 카테고리별 시트의 산출 결과물이 양식이 조금 다르므로
        ## 각 단위 데이터가 리스트인지 여부를 확인후 펼쳐주는 구간 추가
        lambda x: list(chain(*x)) if all(map(lambda y: isinstance(y, list),x)) else x,
    )    

    return res

def dataToDict_tmp(setDict_f, args, cat=None): ### 디버깅 용으로만 한정적 사용
    (datas_perType, hdrs_withIdx) = args
    res = go(
        datas_perType,
        ## 
        map( lambda datas: \
            setDict_f(datas, hdrs_withIdx, cat=cat) if cat=="roomCat" \
            else setDict_f(datas, hdrs_withIdx)
        ), list,
    )
    
    return res

def merge_wmSpecs_sameKey(d:dict):
    pass
    

def match_FamTypeWithCalcType(calcStdTypeDict, allCatFamTypeDict):
    allFamTypeDicts = list(chain(*allCatFamTypeDict))
    res = dictsMerge(allFamTypeDicts)
    
    return res
    pass


calcStdTypeData = get_DataOnRowAreasAtSheet(calcStdSheet, "구간판별", "#")
calcStdTypeDict = dataToDict(setDict_OnEachCalType, calcStdTypeData)

#roomFamTypeData = get_DataOnRowAreasAtSheet(allCatSheets[0], "Standard Type", "H_")
#roomFamTypeDict = dataToDict(setDict_OnEachFamType, roomFamTypeData, cat="roomCat")
#
#allCatFamTypeData = map( lambda x: get_DataOnRowAreasAtSheet(x, "Standard Type", "H_"), allCatSheets[1:] )
#allCatFamTypeDict = [roomFamTypeDict] + list(map( lambda x: dataToDict(setDict_OnEachFamType, x), allCatFamTypeData ))

#allCatFamType_CalcDict = 

floorsFamTypeData = get_DataOnRowAreasAtSheet(allCatSheets[1], "Standard Type", "H_")
#floorsFamTypeDict = dataToDict(setDict_OnEachFamType, floorsFamTypeData)
res = setDict_OnEachFamType(floorsFamTypeData)

#roofsFamTypeData = get_DataOnRowAreasAtSheet(allCatSheets[2], "Standard Type", "H_")
#roofsFamTypeDict = dataToDict(setDict_OnEachFamType, roofsFamTypeData)
#
#wallsExtFamTypeData = get_DataOnRowAreasAtSheet(allCatSheets[3], "Standard Type", "H_")
#wallsExtFamTypeDict = dataToDict(setDict_OnEachFamType, wallsExtFamTypeData)
#
#wallsIntFamTypeData = get_DataOnRowAreasAtSheet(allCatSheets[4], "Standard Type", "H_")
#wallsIntFamTypeDict = dataToDict(setDict_OnEachFamType, wallsIntFamTypeData)
#
#stFdnsFamTypeData = get_DataOnRowAreasAtSheet(allCatSheets[5], "Standard Type", "H_")
#stFdnsFamTypeDict = dataToDict(setDict_OnEachFamType, stFdnsFamTypeData)
#
#stColsFamTypeData = get_DataOnRowAreasAtSheet(allCatSheets[6], "Standard Type", "H_")
#stColsFamTypeDict = dataToDict(setDict_OnEachFamType, stColsFamTypeData)
#
#stFrmsFamTypeData = get_DataOnRowAreasAtSheet(allCatSheets[7], "Standard Type", "H_")
#stFrmsFamTypeDict = dataToDict(setDict_OnEachFamType, stFrmsFamTypeData)
#
#ceilingsFamTypeData = get_DataOnRowAreasAtSheet(allCatSheets[8], "Standard Type", "H_")
#ceilingsFamTypeDict = dataToDict(setDict_OnEachFamType, ceilingsFamTypeData)
#
#doorsFamTypeData = get_DataOnRowAreasAtSheet(allCatSheets[9], "Standard Type", "H_")
#doorsFamTypeDict = dataToDict(setDict_OnEachFamType, doorsFamTypeData)
#
#windowsFamTypeData = get_DataOnRowAreasAtSheet(allCatSheets[10], "Standard Type", "H_")
#windowsFamTypeDict = dataToDict(setDict_OnEachFamType, windowsFamTypeData)
#
#stairsFamTypeData = get_DataOnRowAreasAtSheet(allCatSheets[11], "Standard Type", "H_")
#stairsFamTypeDict = dataToDict(setDict_OnEachFamType, stairsFamTypeData)

# Assign your output to the OUT variable.

OUT = res#match_FamTypeWithCalcType(calcStdTypeDict, allCatFamTypeDict)
# ----------------------------------------
count = List.Count(list=excel_data_dictionarization_3_0@@L2)
watch_3 = Watch(excel_data_dictionarization_3_0)
code_block_37 = CodeBlock(i=watch_3) { i[0]; }
file_path = Filename("..\etc\_팀교육\프로그래밍 교육\dict_room.json")
stringifyJSON = Data.StringifyJSON(values=excel_data_dictionarization_3_0)
writeText = FileSystem.WriteText(filePath=file_path, text=stringifyJSON)  # frozen
isEmpty = List.IsEmpty(list=excel_data_dictionarization_3_0@@L2)
excel_data_dictionarization_3_0_2 = Python(IN[0]=lang_mode_영_한_select, IN[1]=importExcel, IN[2]=target_sheet_names)  # "Excel data dictionarization_3.0.1"; CPython3
# ---------- excel_data_dictionarization_3_0_2.python (441 lines) ----------
# Load the Python Standard and DesignScript Libraries
import sys
import clr
clr.AddReference('ProtoGeometry')
from Autodesk.DesignScript.Geometry import *

#################################Module For Functional Programing#############################################
from functools import reduce
from itertools import chain
from itertools import groupby
from copy import deepcopy
curry = lambda f: lambda a,*args: f(a, *args) if (len(args)) else lambda *args: f(a, *args)

filter = curry(filter)
map = curry(map)
reduce = curry(reduce)

go = lambda *args: reduce(lambda a,f: f(a), args) ## 함수도 축약 가능 ##

def dictUpdate(dic1,dic2):
    res = dic1.update(dic2)
    #res = {**dic1,**dic2}
    return dic1 #res
    
def dictsMerge(dics):
    res = reduce(dictUpdate, dics)
    return res
    
def dictDeleteKeys(dic, keys):
    for k in keys:
        del dic[k]
    return dic
##############################################################################################################

import re
from functools import partial

# The inputs to this node will be stored as a list in the IN variables.
dataEnteringNode = IN
lang_mode = IN[0]
wholeDatas = IN[1]
db = wholeDatas[1:]
allCatSheetsNames = IN[2][2:]

calcStdSheet = db[0] ##산출기준 시트
allCatSheets = db[1:]


# Place your code below this line

def find_IsInStr(target, string):
    if target == None or string == None:
        pass
    else:
        res = str(target) in str(string)
        return res

def find_range_by_columnItem(db, col_idx, sep_rule):
    tdb = list(map(lambda x: x[col_idx], db)) ##targetTransposedDB (col_idx에 해당하는 데이터만 추출)
    last_idx_tdb = len(tdb)-1
    tdb_enum = enumerate(tdb)
    target_RowNumber = list(filter(lambda x: find_IsInStr(sep_rule, x[1]), tdb_enum))
    endidxs_tmp= list(map(lambda x: x[0]-1,target_RowNumber))
    endidxs_tmp.pop(0)
    endidxs = endidxs_tmp + [last_idx_tdb] ## 각 구간별 마지막 행 번호
    rangeSttIdxs = list(map(lambda x: x[0]+1,target_RowNumber))
    rangeEndIdxs = endidxs
    result = list(zip(rangeSttIdxs, rangeEndIdxs))
    return result

    
def find_headersAtSheet(sheet):
    headers_sheet = map(lambda x: [x[1].replace("\n",""),x[0]], filter(lambda x: x[1] != None, enumerate(sheet[1])))
    
    #return dict(headers_sheet)
    return list(headers_sheet)

def find_rangesAtSheet(sheet, hdrs_withIdx, trgt_hdr, trgt_str):
    hdrs_withIdxDict = dict(hdrs_withIdx)
    return find_range_by_columnItem(sheet, hdrs_withIdxDict[trgt_hdr], trgt_str)


def get_DataOnRowAreasAtSheet(sheet:list, discrHDRStr, discrRowStr):
    """
    판별기준 Header문자열(discrHDRStr)이 들어있는 열에서,
    판별기준 행 문자열(discrRowStr)이 들어있는 행번호 기준으로 구역을 나누어 데이터 리스트 반환
    """
    
    hdrs_withIdx = find_headersAtSheet(sheet)
    rowAreasAtSheet = find_rangesAtSheet(sheet, hdrs_withIdx, discrHDRStr, discrRowStr)
    typesTitle_idx = list(map(lambda x: x[0]-1, rowAreasAtSheet)) # 각 타입 명이 위치한 인덱스
    rowsGrps_perType_withNone = list(map(lambda x: sheet[x[0]-1:x[1]], rowAreasAtSheet))
    # None제거
    rowsGrps_perType = go(
        rowsGrps_perType_withNone,
        ## 하나의 타입을 규정하는 행들의 모임에서
        map(lambda rowGrp: \
        ## 한 행씩 골라서
        map(lambda row: \
        ## 행을 구성하는 셀 값 중 None이 있으면 빈문자열로 치환
        map(lambda cell: "" if cell==None else cell, row), rowGrp) ),
        ## 맵 객체가 반환되므로 리스트 변환
        list,
    )
    
    return (rowsGrps_perType, hdrs_withIdx)


def setDict_OnEachCalType(data_perType, hdrs_withIdx):
    """
    data_perType: '#' 등의 구분기호를 통해 나뉘어진 행 구간 내 전체 데이터_(행기준으로 구분된 형식)
    """
    hdrs_withIdxDict = dict(hdrs_withIdx)
    eff_hdrs_idx = list(zip(*hdrs_withIdx))[1]
    eff_hdrs_name = list(zip(*hdrs_withIdx))[0]
    # 
    calcTypeName = data_perType[0][hdrs_withIdxDict["Q'ty Cal Type Tag"]]

    paramDicts_withTypeName = go(
        data_perType,
        ## 엑셀 "항목" 열에 값이 없는 행 제외
        filter(lambda row: row[hdrs_withIdxDict["항목"]] != None), list,
        
        ## 모든 Null 값 빈문자열로 치환
        map(lambda row: list(map(lambda cell: cell if cell!=None else "",row))), list,

        ## 헤더에 해당하는 행 값을 추출--
        map(lambda row: list(map(lambda idx: row[idx], eff_hdrs_idx))), list,
        
        ## 헤더이름과 행 내부의 값을 2개씩 짝지어 줌
        map(lambda row: list(zip(eff_hdrs_name, row))), list,
        
        ## 헤더이름 : 값의 형태로 각 행 데이터를 딕셔너리로 만듬
        map(lambda x: dict(x)), list,
        
        ## "산출수식 약자" 키에 할당된 값이 빈문자열인 경우 제외
        filter(lambda d: d["산출수식 약자"]!=""), list,
        
        ## 딕셔너리에 "Q'ty Cal Type Tag" 키-값 추가
        map(lambda d: dictUpdate(d,{"Q'ty Cal Type Tag":calcTypeName})), list,
        
        ## 딕셔너리에 "applyForCalc" 키-값 추가
        ## ("수동 입력값"항목이 있는 경우에는 그값을 적용하고 아닌경우 "Parameter"항목 값
        map(lambda d: dictUpdate(d, { "applyForCalc":\
            d["수동 입력값"] if d["수동 입력값"] != "" \
            else d["Parameter"] if d["Parameter"] != "" \
            else 0 })), list,
        
        ## 타입이름을 키값으로 하는 중첩 딕셔너리 형성
        lambda x: {calcTypeName: x},
    )

    return paramDicts_withTypeName

###################################################################################################################
#!!! 함수가 너무 크다 쪼개자
#!!! setDict_OnEachFamType
#!!! -> setDict_EachRow_perGroup//setDict_stdWM_perGroup//setDict_applied_perGroup
###################################################################################################################

#def setDict_OnEachFamType(data_perType, hdrs_withIdx, cat=None):


def setDict_OnEachFamType(data_perType, hdrs_withIdx, cat=None):
    """
    data_perType: '#' 등의 구분기호를 통해 나뉘어진 행 구간 내 전체 데이터_(행기준으로 구분된 형식)
    hdrs_withIdx: 헤더 명과 인덱스 번호가 순서대로 나열된 중첩 리스트
    cat : Room 시트 여부 판별용 입력값
    """
    hdrs_withIdxDict = dict(hdrs_withIdx)
    eff_hdrs_idx = list(zip(*hdrs_withIdx))[1]
    eff_hdrs_name = list(zip(*hdrs_withIdx))[0]
    # data_perType 에서, 타입 그룹 별로 "Q'ty Cal Type Tag" 열에 있는 값이
    # None일때가 있으므로 예외처리를 해주는 구간
    calcTypeName = data_perType[0][hdrs_withIdxDict["Q'ty Cal Type Tag"]] \
        if data_perType[0][hdrs_withIdxDict["Q'ty Cal Type Tag"]]!=None else "N/A"
    stdFamTypeNo = data_perType[0][hdrs_withIdxDict["NO"]]
    stdFamTypeName = data_perType[0][hdrs_withIdxDict["Standard Type"]]

    wmspec_headers = ["Work Master Code", "GaugeCode", "Unit"]\
        + list(filter(lambda x: "Work Cat" in x or "Spec" in x, eff_hdrs_name))\
        + ["Description","입찰_물량산출식", "실행_물량산출식"]
    
    # 그룹 안의 모든 행을 리스트에서 칼럼 명이 붙은 딕셔너리로 전환하는 구간
    # 실제 적용 패밀리 타입 및 각각 개별할당 WM 정리
    rowDicts = go(
        data_perType,
        ## 모든 Null 값 빈문자열로 치환
        map(lambda row: list(map(lambda cell: cell if cell!=None else "",row))), list,
        
        ## 헤더에 해당하는 행 내용을 추출
        map(lambda row: list(map(lambda idx: row[idx], eff_hdrs_idx))), list,
        
        ## 헤더이름과 행 내부의 값을 2개씩 짝지어 줌
        map(lambda row: list(zip(eff_hdrs_name, row))), list,        

        ## 헤더이름 : 값의 형태로 각 행 데이터를 딕셔너리로 만듬
        map(lambda x: dict(x)), list,
    )

    # 그룹 내의 모든 행딕셔너리 들 중 찾고자 하는 규칙에 따라 참거짓 여부를 반환하는 함
    def findRow_AppliedType(rowDict, tgtHDRname, rule=None):
        p = re.compile('[0-9]{3,5}')
        target = str(rowDict[tgtHDRname])
        ## 함수 호출시 구분자(rule) 없이 호출한 경우
        ## -Room Category 시트 용 이며 "Standard Type" 항목의 값이 000형태의 숫자인지를 판별
        ## -Room Category 중 "Standard Type" 칼럼에 룸 넘버, "Family Type Name" 칼럼에 룸 이름 입력하게 되어있음
        if rule==None:
            p = re.compile('[0-9]{3,5}')
            m = p.match(target)
            stdCase = target =="Room No"
            res = all([m or stdCase])
        ## 구분자(rule)가 정규표현식 객체로 들어온 경우
        elif isinstance(rule, re.Pattern):
            m = p.match(target)
            res = all([m])
        ## 구분자(rule)가 문자열로 들어온 경우
        else:
            res = rule in target
        return res
    
    # 그룹 내의 모든 행 딕셔너리 중, 개별 적용 패밀리명이 아닌 공통 WM 항목에 대한 정보 추출
    stdFamTypeInfo = go(
        rowDicts,
        ## 엑셀 "물량산출식", "Work Master Code" 열에 값이 없는 행 제외
        ## Family Type Name에 "H_" 문자열 포함된 경우 제외
        filter(lambda d: d["입찰_물량산출식"] != ""),
        filter(lambda d: d["실행_물량산출식"] != ""),
        filter(lambda d: d["Work Master Code"] != ""),
        filter( lambda d: \
            (not findRow_AppliedType(d, "Standard Type")) or (not findRow_AppliedType(d, "Standard Type", rule="H_")) \
            ### 룸카테고리인 경우는 "Standard Type"항목에 값이 숫자가 아니거나, "H_"문자열이 포함되지 않은 항목 추출
            if cat == "roomCat" else\
            ### 룸카테고리가 아닌 경우, "Family Type Name" 항목에 "H_"문자열 포함되지 않은 항목 추출 
            not findRow_AppliedType(d, "Family Type Name", rule="H_") ),
        list,
        
        # wmSpecs 속성들을 헤더로 하는 새로운 딕셔너리 형성 및 값 추가(값은 list형태)
        map( lambda d: \
            go(
                ### wmspec관련 항목들 값을 리스트로 모음
                map(lambda x: d[x], wmspec_headers), list,
                ### 항목명과 항목값을 모아서 딕셔너리 형태로 변환
                lambda x: zip(wmspec_headers,x), dict,
            )
        ),
        list,
    )
    
    def dictsUnion_withInnerKey(dicts:list,innerkey):
        """
        최상위 키값이 "하나"이고, 그 하위에 종속된 딕셔너리의 키구성이 동일한 복수의 딕셔너리 중 ,
        키 값이 동일한 것이 있을 때 딕셔너리별로 해당 키에 대응하는 값들을
        맨 처음의 딕셔너리로 값으로 재할당하고 해당 딕셔너리만 반환
        """
        # 최상위 키값을 기준으로 딕셔너리들 그루핑
        if len(dicts) != 0:
            groupedDicts = go(
                dicts,
                lambda col: sorted(col, key=lambda x:list(x.keys())),
                lambda col: groupby(col, lambda x: list(x.keys())),
                map(lambda x: list(map(lambda y: list(y), x))),
                list,
            )
            # 최상위 키값이 중복되는 딕셔너리를 모은 리스트
            plurals = list(map(lambda y: y[1], filter(lambda x: len(x[1])>1, groupedDicts)))
            # 최상위 키값이 다른 어떤 딕셔너리와 중복되지 않는 단일 개체들 모은 리스트
            singles = list(map(lambda y: y[1][0], filter(lambda x: len(x[1])==1, groupedDicts)))
            # 하부딕셔너리 구성키 전체
            #hdrs = list(dicts[0][list(dicts[0].keys())[0]].keys())
            
            # plurals 없는 경우 처리
            if len(plurals)==0:
                res = singles
            else:
                newPlurals = []
                for sameKeyGroup in plurals:
                    ### 최상단 키
                    titleKey = list(sameKeyGroup[0].keys())[0]
                    newD = deepcopy(sameKeyGroup[0])
                    newD[titleKey][innerkey]=[]
                    for d in sameKeyGroup:
                        newD[titleKey][innerkey].append(d[titleKey][innerkey][0])
                    newPlurals.append(newD)
                res = newPlurals + singles
        
            return res
        
    # 그룹 내의 모든 행 딕셔너리 중, 개별 적용 패밀리에 대한 정보 추출
    # 엑셀 시트에서 "Family Type Name" 칼럼의 값이 보라색으로 기입된 모든 행 대상
    actualAppliedFamTypeInfo = go( ##!!! 적용 패밀리 이름 동일한게 있을때 내용 합치는 구간 추가 필요
        rowDicts,
        ## Family Type Name 항목 중 "H_" 문자열이 포함된 개체만 필터링
        filter( lambda d: \
            findRow_AppliedType(d, "Standard Type") \
            if cat == "roomCat" else\
            findRow_AppliedType(d, "Family Type Name", rule="H_")
            ),
        
        ## 행 딕셔너리에 wmSpecs 속성 및 값 추가(값은 list형태)
        ##!!! 적용 패밀리 이름 동일한게 있을때 내용 합치는 구간 추가 필요 - 공통 WM 추가 코드는 분리 필요
        map( lambda d: dictUpdate(d, {"wmSpecs": \
            go(
                ### wmspec관련 항목들 값을 리스트로 모음
                map(lambda x: d[x], wmspec_headers), list,
                ### 항목명과 항목값을 모아서 딕셔너리 형태로 변환
                lambda x: zip(wmspec_headers,x), dict,
                
                ### wmSpecs 항목을 리스트 구조로 수정해 두기 & 개별 WM정보가 없는 경우는 리스트에서 제외
                #lambda x: [x] if x["Work Master Code"]!="" else [],
                ### stdFamType의 WM정보와 합치기 - 밖으로 분리 필요
                lambda x: [ *stdFamTypeInfo, x \
                    if x["Work Master Code"]!="" else ["No Individual WM information"] ],
                ### 개별 WM정보가 없는 경우는 리스트에서 제외
                filter(lambda x: isinstance(x,dict)), list,
            ) }) 
        ), list,
        
        ## 밖으로 꺼내진 WorkMaster 관련 속성 삭제
        map(lambda d: dictDeleteKeys(d, wmspec_headers)), list,
        
        ## 딕셔너리에 Q'ty Cal Type Tag 키에 값 업데이트
        map(lambda d: dictUpdate(d,{"Q'ty Cal Type Tag": calcTypeName})), list,
        
        ## 딕셔너리에 Standard Type키에 값 업데이트
        map( lambda d: dictUpdate(d,{"NO":d["Standard Type"], "Standard Type":stdFamTypeName})) \
            if cat=="roomCat" \
            else map(lambda d: dictUpdate(d,{"NO":stdFamTypeNo, "Standard Type":stdFamTypeName}) ), 
        list,
        
        ## 딕셔너리에 wmSpecs 내 "Work Master Code" 값을 GaugeCode 포함한 값으로 업데이트 (필요한가?)
        
        
        ## Family Type Name 문자열을 키값으로 하는 딕셔너리로 변형
        #map(lambda d: {d["Family Type Name"]:d}), list,
        map(lambda d: {f'{d["NO"]}'+"_"+d["Family Type Name"]:d})\
            if cat=="roomCat" \
            else map(lambda d: {d["Family Type Name"]:d}), list,
        
        ## 최상위 키가 1개인 딕셔너리들 중 최상위 키 값이 같은 딕셔너리 들만 "wmSpecs" 내용 합치기
        #lambda x: dictsUnion_withInnerKey(x, "wmSpecs"),
        
    )
    
    return eff_hdrs_idx#actualAppliedFamTypeInfo



def dataToDict(setDict_f, args, cat=None):
    (datas_perType, hdrs_withIdx) = args
    res = go(
        datas_perType,
        ## 
        map( lambda datas: \
            setDict_f(datas, hdrs_withIdx, cat=cat) if cat=="roomCat" \
            else setDict_f(datas, hdrs_withIdx)
        ),
            
        ## 빈 리스트라서 매치할 수 없는 개체 제외
        filter(lambda x: x!=[] and x!=None), list,
        
        ## 산출기준 시트와, 카테고리별 시트의 산출 결과물이 양식이 조금 다르므로
        ## 각 단위 데이터가 리스트인지 여부를 확인후 펼쳐주는 구간 추가
        lambda x: list(chain(*x)) if all(map(lambda y: isinstance(y, list),x)) else x,
    )    

    return res

def dataToDict_tmp(setDict_f, args, cat=None): ### 디버깅 용으로만 한정적 사용
    (datas_perType, hdrs_withIdx) = args
    res = go(
        datas_perType,
        ## 
        map( lambda datas: \
            setDict_f(datas, hdrs_withIdx, cat=cat) if cat=="roomCat" \
            else setDict_f(datas, hdrs_withIdx)
        ), list,
    )
    
    return res

def merge_wmSpecs_sameKey(d:dict):
    pass
    

def match_FamTypeWithCalcType(calcStdTypeDict, allCatFamTypeDict):
    allFamTypeDicts = list(chain(*allCatFamTypeDict))
    res = dictsMerge(allFamTypeDicts)
    
    return res
    pass


calcStdTypeData = get_DataOnRowAreasAtSheet(calcStdSheet, "구간판별", "#")
#calcStdTypeDict = dataToDict(setDict_OnEachCalType, calcStdTypeData)

#roomFamTypeData = get_DataOnRowAreasAtSheet(allCatSheets[0], "Standard Type", "H_")
#roomFamTypeDict = dataToDict(setDict_OnEachFamType, roomFamTypeData, cat="roomCat")
#
#allCatFamTypeData = map( lambda x: get_DataOnRowAreasAtSheet(x, "Standard Type", "H_"), allCatSheets[1:] )
#allCatFamTypeDict = [roomFamTypeDict] + list(map( lambda x: dataToDict(setDict_OnEachFamType, x), allCatFamTypeData ))

#allCatFamType_CalcDict = 

floorsFamTypeData = get_DataOnRowAreasAtSheet(allCatSheets[1], "Standard Type", "H_")
#floorsFamTypeDict = dataToDict(setDict_OnEachFamType, floorsFamTypeData)
#res = setDict_OnEachFamType(floorsFamTypeData)

#roofsFamTypeData = get_DataOnRowAreasAtSheet(allCatSheets[2], "Standard Type", "H_")
#roofsFamTypeDict = dataToDict(setDict_OnEachFamType, roofsFamTypeData)
#
#wallsExtFamTypeData = get_DataOnRowAreasAtSheet(allCatSheets[3], "Standard Type", "H_")
#wallsExtFamTypeDict = dataToDict(setDict_OnEachFamType, wallsExtFamTypeData)
#
#wallsIntFamTypeData = get_DataOnRowAreasAtSheet(allCatSheets[4], "Standard Type", "H_")
#wallsIntFamTypeDict = dataToDict(setDict_OnEachFamType, wallsIntFamTypeData)
#
#stFdnsFamTypeData = get_DataOnRowAreasAtSheet(allCatSheets[5], "Standard Type", "H_")
#stFdnsFamTypeDict = dataToDict(setDict_OnEachFamType, stFdnsFamTypeData)
#
#stColsFamTypeData = get_DataOnRowAreasAtSheet(allCatSheets[6], "Standard Type", "H_")
#stColsFamTypeDict = dataToDict(setDict_OnEachFamType, stColsFamTypeData)
#
#stFrmsFamTypeData = get_DataOnRowAreasAtSheet(allCatSheets[7], "Standard Type", "H_")
#stFrmsFamTypeDict = dataToDict(setDict_OnEachFamType, stFrmsFamTypeData)
#
#ceilingsFamTypeData = get_DataOnRowAreasAtSheet(allCatSheets[8], "Standard Type", "H_")
#ceilingsFamTypeDict = dataToDict(setDict_OnEachFamType, ceilingsFamTypeData)
#
#doorsFamTypeData = get_DataOnRowAreasAtSheet(allCatSheets[9], "Standard Type", "H_")
#doorsFamTypeDict = dataToDict(setDict_OnEachFamType, doorsFamTypeData)
#
#windowsFamTypeData = get_DataOnRowAreasAtSheet(allCatSheets[10], "Standard Type", "H_")
#windowsFamTypeDict = dataToDict(setDict_OnEachFamType, windowsFamTypeData)
#
#stairsFamTypeData = get_DataOnRowAreasAtSheet(allCatSheets[11], "Standard Type", "H_")
#stairsFamTypeDict = dataToDict(setDict_OnEachFamType, stairsFamTypeData)

# Assign your output to the OUT variable.

OUT = calcStdTypeData#match_FamTypeWithCalcType(calcStdTypeDict, allCatFamTypeDict)
# ----------------------------------------
