# Dynamo graph 실행(_)_WorkMaster Injector_2.0.0.dyn "WM_injector_rA(20231010)" (Dynamo 2.16.1.2727)
# Inject the  WM datas as per the Family List

# group: All Data in Excel
file_path = Filename(".\플랜트건축팀_BIM_팀 표준 Family List_Rev.0_SQ3_박기범_20230913.xlsx")  # graph input
file_from_path = FileObject(path=file_path)
code_block = CodeBlock()
# ---------- code_block.designscript (16 lines) ----------
[
"WM-AR",
"물량Param",
"1.Floors",
"2.Roofs",
"3.Walls",
"4.St Fdn",
"5.St Col",
"6.St Framing",
"7.Ceilings",
"8.Doors",
"9.Windows",
"10.Stairs",
"11.Railings"
//,"13.Generic"
];
# ----------------------------------------
boolean = BoolSelector(true)
importExcel = Data.ImportExcel(file=file_from_path, sheetName=code_block, showExcel=boolean)
deconstruct = List.Deconstruct(list=code_block)
deconstruct_2 = List.Deconstruct(list=deconstruct.rest)

# group: Excel data dictionarization
deconstruct_3 = List.Deconstruct(list=importExcel)
lang_mode_영_한_select = BoolSelector(true)
family_list_데이터_파싱_물량param_시트 = Python(IN[0]=deconstruct_3.rest, IN[1]=deconstruct_2.first, IN[2]=lang_mode_영_한_select)  # CPython3
# ---------- family_list_데이터_파싱_물량param_시트.python (133 lines) ----------
# Load the Python Standard and DesignScript Libraries
import sys
import clr
clr.AddReference('ProtoGeometry')
from Autodesk.DesignScript.Geometry import *

from functools import reduce
from functools import partial
from string import ascii_lowercase

def getCharValue(s):
    # 베이스 케이스
    if not s:
        return 0
 
    value = 0
    # 입력 문자열을 대문자로 변환한 후 반복
    for ch in s:
        value = value * 26 + (ord(ch) - ord('A') + 1)
    return value
    
#################################Module For Functional Programing#############################################
curry = lambda f: lambda a,*args: f(a, *args) if (len(args)) else lambda *args: f(a, *args)

filter = curry(filter)
map = curry(map)

def _take(length, iter):
    res = []
    for a in iter:
        res.append(a)
        if len(res) == length:
            return res
        
take = curry(_take)
reduce = curry(reduce)

go = lambda *args: reduce(lambda a,f: f(a), args) ## 함수도 축약 가능 ##
##############################################################################################################
def find_IsInStr(target, str):
    if target == None or str == None:
        pass
    else:
        res = target in str
        return res

def find_range_by_columnItem(db, col_idx, sep_rule):
    tdb = list(map(lambda x: x[col_idx], db))
    last_idx_tdb = len(tdb)-1
    tdb_enum = enumerate(tdb)
    res = list(filter(lambda x: find_IsInStr(sep_rule, x[1]), tdb_enum))
    endidxs_tmp= list(map(lambda x: x[0]-1,res))
    #endidxs_tmp= list(map(lambda x: x[0],res))
    endidxs_tmp.pop(0)
    endidxs = endidxs_tmp + [last_idx_tdb]
    famTypeNames = list(map(lambda x: x[1],res))
    famTypeNamesIdxs = list(map(lambda x: x[0],res))
    rangeSttIdxs = list(map(lambda x: x[0]+1,res))
    rangeEndIdxs = endidxs
    result = dict(zip(famTypeNames, zip(famTypeNamesIdxs, zip(rangeSttIdxs,rangeEndIdxs))))
    return result

# The inputs to this node will be stored as a list in the IN variables.
dataEnteringNode = IN
db = IN[0]
allCatSheetsNames =IN[1]
lang_mode = IN[2]

paramSheet = db[0]
allCatSheets = db[1:]

# Place your code below this line

def find_headersAtCatSheet(catSheet):
    headers_CatSheet = map(lambda x: [x[1].replace("\n",""),x[0]], filter(lambda x: x[1] != None, enumerate(catSheet[1])))
    
    return dict(headers_CatSheet)

def find_rangesAtCatSheet(catSheet, hdrs_withIdx):
    return find_range_by_columnItem(catSheet, hdrs_withIdx["Q'ty Cal Type Tag"], "-")

def get_DataOnRangesAtCatSheet(Sheet):
    
    hdrs_withIdx = find_headersAtCatSheet(Sheet)
    title_idx = map(lambda x: x[0], find_rangesAtCatSheet(Sheet, hdrs_withIdx).values())
    calcType_colDatas = list(map(lambda x: x[hdrs_withIdx["Q'ty Cal Type Tag"]], Sheet))
    calcTypes = list(map(lambda x: calcType_colDatas[x], title_idx))
    rgs_v = list(map(lambda x: x[1], find_rangesAtCatSheet(Sheet, hdrs_withIdx).values()))
    rgs_k = list(map(lambda x: x, find_rangesAtCatSheet(Sheet, hdrs_withIdx).keys()))
    
    hdrs_v = list(hdrs_withIdx.values())
    hdrs_k = list(hdrs_withIdx.keys())
    eff_hdrs_v = hdrs_v[2:]
    eff_hdrs_k = hdrs_k[2:]
    
    datas_allCalType = list(map(lambda x: Sheet[x[0]-1:x[1]], rgs_v))
    
    def setDict_OnEachCalType(data_calType):
        paramName_lang = "패밀리 매개변수(from Revit) 영문판" if lang_mode is True else "패밀리 매개변수(from Revit) 한글판"
        calcTypeName = data_calType[0][2]
        data_calType_noneless = list(filter(lambda x: x[hdrs_withIdx["항목"]] != None, data_calType))
#        ## WM row 별 header명 과 짝짓기
        data_withHdrsIdx = list(map(lambda y: list(map(lambda x: y[x], eff_hdrs_v)), data_calType_noneless))
        dict_ = list(map(lambda x: dict(zip(eff_hdrs_k, x)), data_withHdrsIdx))
        dicts_noneless = list(map(lambda y: dict(filter(lambda x: x[1]!=None, y.items())),dict_))
#        ## dict_Cal Type 입력처리
        targetColName = "Q'ty Cal Type Tag"
        dicts_finalNoneless = []
        for d in dicts_noneless:
            d["Q'ty Cal Type Tag"] = calcTypeName
            
            if "입력값" in d.keys():
                d["applyForCalc"] = d["입력값"]
                dicts_finalNoneless.append(d)
            elif paramName_lang in d.keys():
                d["applyForCalc"] = d[paramName_lang]
                dicts_finalNoneless.append(d)
            else:
                pass
        
        return {calcTypeName: dicts_finalNoneless}
        
    return map(setDict_OnEachCalType, datas_allCalType)
each_dict = get_DataOnRangesAtCatSheet(paramSheet)
dicts_AllInOne = {}
for d in each_dict:
    dict_k_v = d.items()
    for k,v in dict_k_v:
        dicts_AllInOne[k] = v
# Assign your output to the OUT variable.


OUT = dicts_AllInOne
# ----------------------------------------
물량param시트_약자_매개변수_정리 = Python(IN[0]=family_list_데이터_파싱_물량param_시트)  # CPython3
# ---------- 물량param시트_약자_매개변수_정리.python (32 lines) ----------
# Load the Python Standard and DesignScript Libraries
import sys
import clr
clr.AddReference('ProtoGeometry')
from Autodesk.DesignScript.Geometry import *

clr.AddReference("RevitNodes")
import Revit
from Revit.Elements import *

from functools import reduce
from functools import partial
from string import ascii_lowercase

# The inputs to this node will be stored as a list in the IN variables.
dataEnteringNode = IN
paramSheetDic = IN[0]
# Place your code below this line

def findDictPerCalType(dicList):
    dic = {}
    for i in dicList:
        dic[i["산출수식 약자"]] = i["applyForCalc"]
    
    return dic

ks_forDic = list(paramSheetDic.keys())
vs_forDic = list(map(findDictPerCalType, paramSheetDic.values()))

res = dict(zip(ks_forDic, vs_forDic))
# Assign your output to the OUT variable.
OUT = res
# ----------------------------------------
family_list_데이터_파싱_category_시트 = Python(IN[0]=deconstruct_3.rest, IN[1]=deconstruct_2.rest)  # CPython3
# ---------- family_list_데이터_파싱_category_시트.python (147 lines) ----------
# Load the Python Standard and DesignScript Libraries
import sys
import clr
clr.AddReference('ProtoGeometry')
from Autodesk.DesignScript.Geometry import *

from functools import reduce
from functools import partial
from string import ascii_lowercase

def getCharValue(s):
    # 베이스 케이스
    if not s:
        return 0
 
    value = 0
    # 입력 문자열을 대문자로 변환한 후 반복
    for ch in s:
        value = value * 26 + (ord(ch) - ord('A') + 1)
    return value
    
#################################Module For Functional Programing#############################################
curry = lambda f: lambda a,*args: f(a, *args) if (len(args)) else lambda *args: f(a, *args)

filter = curry(filter)
map = curry(map)

def _take(length, iter):
    res = []
    for a in iter:
        res.append(a)
        if len(res) == length:
            return res
        
take = curry(_take)
reduce = curry(reduce)

go = lambda *args: reduce(lambda a,f: f(a), args) ## 함수도 축약 가능 ##
##############################################################################################################
def find_IsInStr(target, str):
    if target == None or str == None:
        pass
    else:
        res = target in str
        return res

def find_range_by_columnItem(db, col_idx, sep_rule):
    tdb = list(map(lambda x: x[col_idx], db))
    last_idx_tdb = len(tdb)-1
    tdb_enum = enumerate(tdb)
    res = list(filter(lambda x: find_IsInStr(sep_rule, x[1]), tdb_enum))
    endidxs_tmp= list(map(lambda x: x[0]-1,res))
    #endidxs_tmp= list(map(lambda x: x[0],res))
    endidxs_tmp.pop(0)
    endidxs = endidxs_tmp + [last_idx_tdb]
    famTypeNames = list(map(lambda x: x[1],res))
    famTypeNamesIdxs = list(map(lambda x: x[0],res))
    rangeSttIdxs = list(map(lambda x: x[0]+1,res))
    rangeEndIdxs = endidxs
    result = dict(zip(famTypeNames, zip(famTypeNamesIdxs, zip(rangeSttIdxs,rangeEndIdxs))))
    return result

# The inputs to this node will be stored as a list in the IN variables.
dataEnteringNode = IN
db = IN[0]
allCatSheetsNames =IN[1]


paramSheet = db[0]
allCatSheets = db[1:]

# Place your code below this line

def find_headersAtCatSheet(catSheet):
    headers_CatSheet = map(lambda x: [x[1].replace("\n",""),x[0]], filter(lambda x: x[1] != None, enumerate(catSheet[1])))
    
    return dict(headers_CatSheet)

def find_rangesAtCatSheet(catSheet, hdrs_withIdx):
    return find_range_by_columnItem(catSheet, hdrs_withIdx["Family Type Name"], "H_")

def get_DataOnRangesAtCatSheet(catSheet): 
    hdrs_withIdx = find_headersAtCatSheet(catSheet)
    title_idx = map(lambda x: x[0], find_rangesAtCatSheet(catSheet, hdrs_withIdx).values())
    calcType_colDatas = list(map(lambda x: x[hdrs_withIdx["Q'ty Cal Type Tag"]], catSheet))
    calcTypes = list(map(lambda x: calcType_colDatas[x], title_idx))
    rgs_v = list(map(lambda x: x[1], find_rangesAtCatSheet(catSheet, hdrs_withIdx).values()))
    rgs_k = list(map(lambda x: x, find_rangesAtCatSheet(catSheet, hdrs_withIdx).keys()))
    
    hdrs_v = list(hdrs_withIdx.values())
    hdrs_k = list(hdrs_withIdx.keys())
    #tagDatas = list(zip(rgs_k,calcTypes))
    
    datas_allFamType = list(map(lambda x: list(zip(catSheet[x[0]-1:x[1]], range(x[0]-1,x[1]))), rgs_v))
    #datas_allFamType = list(zip(tagDatas, datas_allFamType_))
    
    def setDict_OnEachFamType(data_famType):  ## 최종적으로 산출식 없는 것 걸러내기 추가해야 함
        titleData = list(data_famType).pop(0)[0]
        
        famTypeName = titleData[hdrs_withIdx["Family Type Name"]]
        calcTypeName = titleData[hdrs_withIdx["Q'ty Cal Type Tag"]]
        data_famType_noneless = list(filter(lambda x: x[0][5] != None, data_famType))
        ## WM row 별 header명 과 짝짓기
        data_withHdrsIdx = list(map(lambda y: [list(map(lambda x: y[0][x], hdrs_v)), y[1]], data_famType_noneless))
        hdrs_k.append("rIDX")
        dict_ = list(map(lambda x: dict(zip(hdrs_k, x[0]+[x[1]])), data_withHdrsIdx))
        dicts_noneless = list(map(lambda y: dict(filter(lambda x: x[1]!=None, y.items())),dict_))
        ## dict_gauge, 물량산출식 없는 항목 처리
        dicts_final = []
        needDefault_ColName = "Gauge Code"
        noneRemove_ColName = "Dynamo 물량산출식"
        for d in dicts_noneless:
            d["Family Type Name"] = famTypeName
            
            if calcTypeName == None:
                pass            
            elif noneRemove_ColName in d.keys():
                d["Q'ty Cal Type Tag"] = calcTypeName
                d[needDefault_ColName] = ""
                dicts_final.append(d)

        
        return dicts_final
        
    dicts_allFamType = list(map(lambda x: setDict_OnEachFamType(list(x)), datas_allFamType))
    ds_famTypesAtCatSheet = dict(zip(rgs_k, dicts_allFamType))
    ds_famTypesAtCatSheet_effCalcType = dict(filter(lambda x: all(list(map(lambda i: "Q'ty Cal Type Tag" in i, x[1]))), list(ds_famTypesAtCatSheet.items())))
    ds_famTypesAtCatSheet_noneless = dict(filter(lambda x: len(list(x[1]))!=0, list(ds_famTypesAtCatSheet_effCalcType.items())))
    
    return  ds_famTypesAtCatSheet_noneless

## AllInOne 딕셔너리에 정리
dataOnRanges_allCat = list(map(get_DataOnRangesAtCatSheet, allCatSheets))
dataOnRanges_allCat_WithCatNames = list(zip(allCatSheetsNames, dataOnRanges_allCat))
dicts_AllInOne = {}

for d in dataOnRanges_allCat_WithCatNames:
    catName = d[0]
    dict_k_v = d[1].items()
    for k,v in dict_k_v:
        for wm in v:
            wm["SheetName"] = catName
        dicts_AllInOne[k] = v

# Assign your output to the OUT variable.
OUT = dicts_AllInOne
#OUT = get_DataOnRangesAtCatSheet(allCatSheets[0])#allCatSheetsWithNames#
# ----------------------------------------
family_list_데이터_파싱_category = Python(IN[0]=물량param시트_약자_매개변수_정리, IN[1]=family_list_데이터_파싱_category_시트)  # "Family List 데이터 파싱_Category - 물량Param 시트 결합"; CPython3
# ---------- family_list_데이터_파싱_category.python (46 lines) ----------
# Load the Python Standard and DesignScript Libraries
import sys
import clr
clr.AddReference('ProtoGeometry')
from Autodesk.DesignScript.Geometry import *

clr.AddReference("RevitNodes")
import Revit
from Revit.Elements import *

from functools import reduce
from functools import partial
from string import ascii_lowercase

# The inputs to this node will be stored as a list in the IN variables.
dataEnteringNode = IN
paramSheetDic = IN[0]
catSheetDic = IN[1]

# Place your code below this line
headers = list(catSheetDic.values())[0][0].Keys
wmspec_headers = list(filter(lambda x: "Work C" in x or "Spec" in x, headers))

def matchWith_paramDic(catSheetDic, paramSheetDic):
    res = {}
    for famType,diclist in catSheetDic.items():
        new_diclist = []
        for d in diclist:
            new_d = {}
            keys = d.Keys
            keys_new = set(keys) - set(wmspec_headers)
            calcType = d["Q'ty Cal Type Tag"]
            new_d["Sym_Val Dict"] = paramSheetDic[calcType]
            new_d["wmSpecs"] = list(map(lambda x: d[x],wmspec_headers))
            for spec in keys_new:
                new_d[spec] = d[spec]
            new_diclist.append(new_d)
        
        res[famType] = new_diclist
        
    return res
    

#res2 = map(lambda x: x[1], catSheetDic.items())
# Assign your output to the OUT variable.
OUT = matchWith_paramDic(catSheetDic, paramSheetDic)
# ----------------------------------------

# group: All Elements in Revit
all_elementsexceptrails = Python()  # CPython3; unwired: IN[0]
# ---------- all_elementsexceptrails.python (51 lines) ----------
# Load the Python Standard and DesignScript Libraries
import sys
import clr
clr.AddReference('ProtoGeometry')
from Autodesk.DesignScript.Geometry import *

clr.AddReference('RevitAPI')
from Autodesk.Revit.DB import *
import Autodesk

clr.AddReference('RevitServices')
import RevitServices
from RevitServices.Persistence import DocumentManager
doc = DocumentManager.Instance.CurrentDBDocument

def get_all_BIC():

    db = [
    Autodesk.Revit.DB.BuiltInCategory.OST_Floors,
    Autodesk.Revit.DB.BuiltInCategory.OST_Roofs,
    Autodesk.Revit.DB.BuiltInCategory.OST_Walls,
    Autodesk.Revit.DB.BuiltInCategory.OST_StructuralFoundation,
    Autodesk.Revit.DB.BuiltInCategory.OST_StructuralColumns,
    Autodesk.Revit.DB.BuiltInCategory.OST_StructuralFraming,
    Autodesk.Revit.DB.BuiltInCategory.OST_Ceilings,
    Autodesk.Revit.DB.BuiltInCategory.OST_Doors,
    Autodesk.Revit.DB.BuiltInCategory.OST_Windows,
    Autodesk.Revit.DB.BuiltInCategory.OST_Stairs,
    #Autodesk.Revit.DB.BuiltInCategory.OST_Railings,
    ]
    return db
    
def get_allElems(doc):
    bics = get_all_BIC()
    
    def getElems(x):
        collector = FilteredElementCollector(doc)
        res = collector.OfCategory(x).WhereElementIsNotElementType().ToElements()
        return res

    def getRailElems(x):
        collector = FilteredElementCollector(doc)
        res = collector.OfCategory(x).WhereElementIsNotElementType()
        return res

    res = map(getElems, bics)
#    res = getRailElems(Autodesk.Revit.DB.BuiltInCategory.OST_RailingSystemRail)
    return res


OUT = get_allElems(doc)
# ----------------------------------------
categories = Categories("OST_StairsRailing")
all_elements_of_category = ElementsOfCategory(Category=categories)
list_create = List.Create(item0=all_elements_of_category)
join = List.Join(list0=all_elementsexceptrails, list1=list_create)

# group: 필터링 구간 (패밀리 리스트에 없는 이름 제외)
flatten = List.Flatten(list=join)
code_block_2 = CodeBlock { "Type"; "Type Name"; }
getParameterValueByName = Element.GetParameterValueByName(element=flatten, parameterName=code_block_2.out0)
keys = DesignScript.Builtin.Dictionary.Keys(dictionary=family_list_데이터_파싱_category_시트)
getParameterValueByName_2 = Element.GetParameterValueByName(element=getParameterValueByName, parameterName=code_block_2.out1)
contains = List.Contains(list=keys, item=getParameterValueByName_2@L1)
filterByBoolMask = List.FilterByBoolMask(list=flatten, mask=contains)
code_block_3 = CodeBlock(filtered=filterByBoolMask.in) { filtered; }

# group: Family Type 별 WM 코드 Revit 되먹임
# note: Revit에 있는 Family Type 항목만
filterByBoolMask_2 = List.FilterByBoolMask(list=getParameterValueByName, mask=contains)
uniqueItems = List.UniqueItems(list=filterByBoolMask_2.in)
code_block_4 = CodeBlock(catSheetDatas=family_list_데이터_파싱_category, UniqElemTypes=uniqueItems) { catSheetDatas; UniqElemTypes; }
code_block_5 = CodeBlock { "Type"; "Type Name"; }
getParameterValueByName_3 = Element.GetParameterValueByName(element=code_block_4.UniqElemTypes, parameterName=code_block_5.out1)
valueAtKey = DesignScript.Builtin.Dictionary.ValueAtKey(dictionary=code_block_4.catSheetDatas, key=getParameterValueByName_3)
byKeysValues = DesignScript.Builtin.Dictionary.ByKeysValues(keys=getParameterValueByName_3, values=valueAtKey)
code_block_6 = CodeBlock { "Q'ty Cal Type Tag"; }
get_WMCodesAndBriefSpec = Python(IN[0]=byKeysValues, IN[1]=code_block_6)  # CPython3
# ---------- get_WMCodesAndBriefSpec.python (33 lines) ----------
# Load the Python Standard and DesignScript Libraries
import sys
import clr
clr.AddReference('ProtoGeometry')
from Autodesk.DesignScript.Geometry import *

# The inputs to this node will be stored as a list in the IN variables.
dataEnteringNode = IN
dict_aio = IN[0]
calType_header = IN[1]
# Place your code below this line
famTypes = list(dict_aio.items())
res_dict = {}


def find_WMspecsPerFamType(k_v):
    k = k_v[0]
    wms = k_v[1]
    res = list(map(lambda x: [x["Work Master Code"]] + x["wmSpecs"], wms))
    res_zeroless = list(map(lambda y: filter(lambda x: x!=0, y), res))
    joined_strs = list(map(lambda x: ' | '.join(x),res_zeroless))

    return k,joined_strs

WMspecs = list(map(find_WMspecsPerFamType, famTypes))

for k,v in WMspecs:
    res_dict[k] = [dict_aio[k][0][calType_header]] + v



# Assign your output to the OUT variable.
OUT = res_dict
# ----------------------------------------
valueAtKey_2 = DesignScript.Builtin.Dictionary.ValueAtKey(dictionary=get_WMCodesAndBriefSpec, key=getParameterValueByName_3)
code_block_7 = CodeBlock()
# ---------- code_block_7.designscript (12 lines) ----------
[
"H_Q'ty Cal Type Tag",
"H_WM Code_1",
"H_WM Code_2",
"H_WM Code_3",
"H_WM Code_4",
"H_WM Code_5",
"H_WM Code_6",
"H_WM Code_7",
"H_WM Code_8",
"H_WM Code_9"
];
# ----------------------------------------
setParamElementTypes = Python(IN[0]=code_block_4.UniqElemTypes, IN[1]=valueAtKey_2, IN[2]=code_block_7)  # CPython3
# ---------- setParamElementTypes.python (36 lines) ----------
# Load the Python Standard and DesignScript Libraries
import sys
import clr
clr.AddReference('ProtoGeometry')
from Autodesk.DesignScript.Geometry import *

clr.AddReference("RevitNodes")
import Revit
from Revit.Elements import *

# The inputs to this node will be stored as a list in the IN variables.
dataEnteringNode = IN
elemTypes = IN[0]
WMs_perFamTyp = IN[1]
param_ListForWM = IN[2]

input_sets = list(zip(elemTypes, WMs_perFamTyp))

# Place your code below this line

def setParamAnElem(elem, paramNames, paramVals):
    effName_List = paramNames[:len(paramVals)]
    effVals_List = paramVals
    setForParam = list(zip(effName_List, effVals_List))
    res = list(map(lambda x: elem.SetParameterByName(x[0],x[1]), setForParam))
    
    return res


final = map(lambda x: setParamAnElem(x[0],param_ListForWM,x[1]), input_sets)


#res = elemT.GetParameterValueByName("Default Thickness")
# Assign your output to the OUT variable.
#OUT = input_sets
OUT = final
# ----------------------------------------

# group: 임시 - WM 파라미터 생성
spec_types = SpecTypes("autodesk.spec:spec.string")
group_types = GroupTypes("autodesk.parameter.group:materials")
code_block_8 = CodeBlock(specT=spec_types, groupT=group_types)
# ---------- code_block_8.designscript (19 lines) ----------
[
"H_Q'ty Cal Type Tag",
"H_WM Code_1",
"H_WM Code_2",
"H_WM Code_3",
"H_WM Code_4",
"H_WM Code_5",
"H_WM Code_6",
"H_WM Code_7",
"H_WM Code_8",
"H_WM Code_9"
];
"H_WM Code";
specT;
groupT;
false;
//타입;
true;
//인스턴스;
# ----------------------------------------
createProjectParameterForAllCategories = Parameter.CreateProjectParameterForAllCategories(parameterName=code_block_8.out0, groupName=code_block_8.out1, specType=code_block_8.specT, groupType=code_block_8.groupT, instance=code_block_8.out4)  # frozen
