# Dynamo graph dictionary 활용.dyn (Dynamo 2.10.1.3976)

code_block = CodeBlock()
# ---------- code_block.designscript (5 lines) ----------
[
"length",
"level",
"solid"
];
# ----------------------------------------
byKeysValues = DesignScript.Builtin.Dictionary.ByKeysValues(keys=code_block@L2)  # unwired: values
categories = Categories("OST_Walls")
all_elements_of_category = ElementsOfCategory(Category=categories)
code_block_2 = CodeBlock { "Length"; }
getParameterValueByName = Element.GetParameterValueByName(element=all_elements_of_category, parameterName=code_block_2)
parameters = Element.Parameters(element=all_elements_of_category)
code_block_3 = CodeBlock { 0; }
getItemAtIndex = List.GetItemAtIndex(list=parameters@L2, index=code_block_3)
geometry = Element.Geometry(element=all_elements_of_category)
list_create = List.Create(item0=getParameterValueByName, item1=getItemAtIndex, item2=geometry)
transpose = List.Transpose(lists=list_create)
code_block_4 = CodeBlock()  # same code as code_block
byKeysValues_2 = DesignScript.Builtin.Dictionary.ByKeysValues(keys=code_block_4)  # unwired: values
map = List.Map(list=transpose, function=byKeysValues_2)
code_block_5 = CodeBlock { "length"; }
valueAtKey = DesignScript.Builtin.Dictionary.ValueAtKey(dictionary=map, key=code_block_5)
code_block_6 = CodeBlock { "Type"; }
getParameterValueByName_2 = Element.GetParameterValueByName(element=all_elements_of_category, parameterName=code_block_6)
code_block_7 = CodeBlock { "Type Name"; }
getParameterValueByName_3 = Element.GetParameterValueByName(element=getParameterValueByName_2, parameterName=code_block_7)
