# Dynamo graph dictionary 활용_거푸집_rC.dyn (Dynamo 2.10.1.3976)

categories = Categories("OST_Walls")
all_elements_of_category = ElementsOfCategory(Category=categories)
parameters = Element.Parameters(element=all_elements_of_category)
code_block = CodeBlock { "Type"; }
getParameterValueByName = Element.GetParameterValueByName(element=all_elements_of_category, parameterName=code_block)
code_block_2 = CodeBlock { "Type Name"; }
getParameterValueByName_2 = Element.GetParameterValueByName(element=getParameterValueByName, parameterName=code_block_2)
groupByKey = List.GroupByKey(list=all_elements_of_category, keys=getParameterValueByName_2)
byKeysValues = DesignScript.Builtin.Dictionary.ByKeysValues(keys=groupByKey.unique_keys, values=groupByKey.groups)
code_block_3 = CodeBlock(i=groupByKey.unique_keys) { i[7]; }
valueAtKey = DesignScript.Builtin.Dictionary.ValueAtKey(dictionary=byKeysValues, key=code_block_3)
code_block_4 = CodeBlock { "elem"; }

# group: dictionary 생성
byKeysValues_2 = DesignScript.Builtin.Dictionary.ByKeysValues(keys=code_block_4)  # unwired: values
map = List.Map(list=valueAtKey, function=byKeysValues_2)

code_block_5 = CodeBlock { "area"; }
values = DesignScript.Builtin.Dictionary.Values(dictionary=map)
code_block_6 = CodeBlock { "Area"; }
getParameterValueByName_3 = Element.GetParameterValueByName(element=values, parameterName=code_block_6)

# group: dictionary 속성 추가
code_block_7 = CodeBlock(preDict=map) { preDict; }
count = List.Count(list=code_block_7)
ofRepeatedItem = List.OfRepeatedItem(item=code_block_5, amount=count)
setValueAtKeys = DesignScript.Builtin.Dictionary.SetValueAtKeys(dictionary=code_block_7, keys=ofRepeatedItem, values=getParameterValueByName_3, lacing=Shortest)

code_block_8 = CodeBlock { "srfs"; }
code_block_9 = CodeBlock { "elem"; }
valueAtKey_2 = DesignScript.Builtin.Dictionary.ValueAtKey(dictionary=setValueAtKeys, key=code_block_9)
faces = Element.Faces(element=valueAtKey_2)

# group: dictionary 속성 추가
code_block_10 = CodeBlock(preDict=setValueAtKeys) { preDict; }
count_2 = List.Count(list=code_block_10)
ofRepeatedItem_2 = List.OfRepeatedItem(item=code_block_8, amount=count_2)
list_create = List.Create()  # unwired: item0
map_2 = List.Map(list=faces, function=list_create)
setValueAtKeys_2 = DesignScript.Builtin.Dictionary.SetValueAtKeys(dictionary=code_block_10, keys=ofRepeatedItem_2, values=map_2, lacing=Shortest)

code_block_11 = CodeBlock(preDict=setValueAtKeys_2) { preDict; }
code_block_12 = CodeBlock { "side srfs"; }
code_block_13 = CodeBlock { "srfs"; }
valueAtKey_3 = DesignScript.Builtin.Dictionary.ValueAtKey(dictionary=code_block_11, key=code_block_13)

# group: 합성 함수 for side faces_boolmask
code_block_14 = CodeBlock { 0.5; }
normalAtParameter = Surface.NormalAtParameter(u=code_block_14, v=code_block_14)  # unwired: surface
Z = Vector.Z()  # unwired: vector
abs = Math.Abs()  # unwired: number
code_block_15 = CodeBlock { 1; }
ne = _ != code_block_15  # unwired: x
function_compose = ComposeFunctions(function0=normalAtParameter, function1=Z, function2=abs, function3=ne)

map_3 = List.Map(list=valueAtKey_3, function=function_compose)
filterByBoolMask = List.FilterByBoolMask(list=valueAtKey_3, mask=map_3)

# group: dictionary 속성 추가
mkNewDict = Python(IN[0]=code_block_11, IN[1]=code_block_12, IN[2]=filterByBoolMask.in)  # CPython3
# ---------- mkNewDict.python (24 lines) ----------
# Load the Python Standard and DesignScript Libraries
import sys
import clr
clr.AddReference('ProtoGeometry')
from Autodesk.DesignScript.Geometry import *

# The inputs to this node will be stored as a list in the IN variables.
dataEnteringNode = IN

preDicts = IN[0]
newKey = IN[1]
newValues = IN[2]

# Place your code below this line

kvPairs = zip(preDicts, newValues)

def mkNewDict(_dict, _key, _value):
    _dict[_key] = _value
    return _dict

result = map(lambda x: mkNewDict(x[0], newKey, x[1]), kvPairs)
# Assign your output to the OUT variable.
OUT = result
# ----------------------------------------

code_block_16 = CodeBlock { "form panel"; }
code_block_17 = CodeBlock { "side srfs"; }
valueAtKey_4 = DesignScript.Builtin.Dictionary.ValueAtKey(dictionary=mkNewDict, key=code_block_17)
code_block_18 = CodeBlock { 50; }
code_block_19 = CodeBlock { false; }
thicken = Surface.Thicken(surface=valueAtKey_4, thickness=code_block_18, both_sides=code_block_19)

# group: dictionary 속성 추가
mkNewDict_2 = Python(IN[0]=mkNewDict, IN[1]=code_block_16, IN[2]=thicken)  # CPython3; same code as mkNewDict

code_block_20 = CodeBlock { "form panel outface"; }
code_block_21 = CodeBlock { "side srfs"; }
valueAtKey_5 = DesignScript.Builtin.Dictionary.ValueAtKey(dictionary=mkNewDict_2, key=code_block_21)
code_block_22 = CodeBlock { 0.5; }
normalAtParameter_2 = Surface.NormalAtParameter(surface=valueAtKey_5, u=code_block_22, v=code_block_22)
code_block_23 = CodeBlock { 50; }
translate = Geometry.Translate(geometry=valueAtKey_5, direction=normalAtParameter_2, distance=code_block_23)

# group: dictionary 속성 추가
mkNewDict_3 = Python(IN[0]=mkNewDict_2, IN[1]=code_block_20, IN[2]=translate)  # CPython3; same code as mkNewDict

code_block_24 = CodeBlock { "form panel outface"; }
valueAtKey_6 = DesignScript.Builtin.Dictionary.ValueAtKey(dictionary=mkNewDict_3, key=code_block_24)
code_block_25 = CodeBlock { 0.1..0.9..0.2; }
code_block_26 = CodeBlock { 0..1; }
pointAtParameter = Surface.PointAtParameter(surface=valueAtKey_6, u=code_block_25, v=code_block_26, lacing=CrossProduct)
transpose = List.Transpose(lists=pointAtParameter@L3)
firstItem = List.FirstItem(list=transpose@L2)
lastItem = List.LastItem(list=transpose@L2)
byStartPointEndPoint = Line.ByStartPointEndPoint(startPoint=firstItem, endPoint=lastItem)
