# Dynamo graph dictionary 활용_거푸집_리팩토링전.dyn (Dynamo 2.13.1.3887)

# note: 다이나모 딕셔너리 활용
# (부제: 복잡한 흐름 속에서 길 잃지 않기)

categories = Categories("OST_Walls")
all_elements_of_category = ElementsOfCategory(Category=categories)
parameters = Element.Parameters(element=all_elements_of_category)
file_path = Filename(".\1.png")
file_from_path = FileObject(path=file_path)
readFromFile = Image.ReadFromFile(file=file_from_path)
# note: 뭐좀 해보려고 하면 금세 지저분해지는 책상
# vs
# 뭐좀 만들려고 하면 금세 지저분해지는 코드
watch_image = WatchImageCore(image=readFromFile)
code_block = CodeBlock { "Type"; }
getParameterValueByName = Element.GetParameterValueByName(element=all_elements_of_category, parameterName=code_block)
code_block_2 = CodeBlock { "Type Name"; }
getParameterValueByName_2 = Element.GetParameterValueByName(element=getParameterValueByName, parameterName=code_block_2)
groupByKey = List.GroupByKey(list=all_elements_of_category, keys=getParameterValueByName_2)
code_block_3 = CodeBlock(i=groupByKey.groups) { i[7]; }
faces = Element.Faces(element=code_block_3)
code_block_4 = CodeBlock { 0.5; }
normalAtParameter = Surface.NormalAtParameter(surface=faces, u=code_block_4, v=code_block_4)
Z = Vector.Z(vector=normalAtParameter)
abs = Math.Abs(number=Z)
code_block_5 = CodeBlock { 1; }
ne = abs != code_block_5
filterByBoolMask = List.FilterByBoolMask(list=faces, mask=ne)
code_block_6 = CodeBlock { 50; }
code_block_7 = CodeBlock { false; }
thicken = Surface.Thicken(surface=filterByBoolMask.in, thickness=code_block_6, both_sides=code_block_7)
explode = Geometry.Explode(geometry=thicken)
code_block_8 = CodeBlock { 0.5; }
normalAtParameter_2 = Surface.NormalAtParameter(surface=explode, u=code_block_8, v=code_block_8)
Z_2 = Vector.Z(vector=normalAtParameter_2)
abs_2 = Math.Abs(number=Z_2)
code_block_9 = CodeBlock { 1; }
ne_2 = abs_2 != code_block_9
filterByBoolMask_2 = List.FilterByBoolMask(list=explode, mask=ne_2)
code_block_10 = CodeBlock { 0.5; }
normalAtParameter_3 = Surface.NormalAtParameter(surface=explode, u=code_block_10, v=code_block_10)
code_block_11 = CodeBlock { 100; }
translate = Geometry.Translate(geometry=filterByBoolMask_2.in, direction=normalAtParameter_3, distance=code_block_11)
code_block_12 = CodeBlock { 0.5; }
normalAtParameter_4 = Surface.NormalAtParameter(surface=translate, u=code_block_12, v=code_block_12)
Z_3 = Vector.Z(vector=normalAtParameter_4)
abs_3 = Math.Abs(number=Z_3)
code_block_13 = CodeBlock { 1; }
ne_3 = abs_3 != code_block_13
filterByBoolMask_3 = List.FilterByBoolMask(list=translate, mask=ne_3)
code_block_14 = CodeBlock(i=filterByBoolMask_3.in) { i; }
code_block_15 = CodeBlock { 0.1..0.9..0.2; }
code_block_16 = CodeBlock { 0..1; }
pointAtParameter = Surface.PointAtParameter(surface=code_block_14@L2, u=code_block_15, v=code_block_16, lacing=CrossProduct)
transpose = List.Transpose(lists=pointAtParameter@L4)
firstItem = List.FirstItem(list=transpose@L4)
lastItem = List.LastItem(list=transpose@L4)
byStartPointEndPoint = Line.ByStartPointEndPoint(startPoint=firstItem, endPoint=lastItem)
startPoint = Curve.StartPoint(curve=byStartPointEndPoint)
direction = Line.Direction(line=byStartPointEndPoint)
byOriginNormal = Plane.ByOriginNormal(origin=startPoint, normal=direction)
code_block_17 = CodeBlock { 50; }
byPlaneRadius = Circle.ByPlaneRadius(plane=byOriginNormal, radius=code_block_17)
bySweep = Solid.BySweep(profile=byPlaneRadius, path=byStartPointEndPoint)
code_block_18 = CodeBlock { 0.5; }
normalAtParameter_5 = Surface.NormalAtParameter(surface=translate, u=code_block_18, v=code_block_18)
code_block_19 = CodeBlock { 100; }
translate_2 = Geometry.Translate(geometry=translate, direction=normalAtParameter_5, distance=code_block_19)
code_block_20 = CodeBlock { 0..1; }
code_block_21 = CodeBlock { 0.1..0.9..0.4; }
pointAtParameter_2 = Surface.PointAtParameter(surface=translate_2@L2, u=code_block_20, v=code_block_21, lacing=CrossProduct)
transpose_2 = List.Transpose(lists=pointAtParameter_2@L4)
firstItem_2 = List.FirstItem(list=transpose_2@L3)
lastItem_2 = List.LastItem(list=transpose_2@L3)
byStartPointEndPoint_2 = Line.ByStartPointEndPoint(startPoint=firstItem_2, endPoint=lastItem_2)
startPoint_2 = Curve.StartPoint(curve=byStartPointEndPoint_2)
direction_2 = Line.Direction(line=byStartPointEndPoint_2)
byOriginNormal_2 = Plane.ByOriginNormal(origin=startPoint_2, normal=direction_2)
code_block_22 = CodeBlock { 50; }
byPlaneRadius_2 = Circle.ByPlaneRadius(plane=byOriginNormal_2, radius=code_block_22)
bySweep_2 = Solid.BySweep(profile=byPlaneRadius_2, path=byStartPointEndPoint_2)
file_path_2 = Filename(".\2.jpeg")
file_from_path_2 = FileObject(path=file_path_2)
readFromFile_2 = Image.ReadFromFile(file=file_from_path_2)
watch_image_2 = WatchImageCore(image=readFromFile_2)
file_path_3 = Filename(".\3.jpg")
file_from_path_3 = FileObject(path=file_path_3)
readFromFile_3 = Image.ReadFromFile(file=file_from_path_3)
watch_image_3 = WatchImageCore(image=readFromFile_3)
