# Dynamo graph dictionary 활용_거푸집_리팩토링후.dyn (Dynamo 2.13.1.3887)

categories = Categories("OST_Walls")
all_elements_of_category = ElementsOfCategory(Category=categories)
parameters = Element.Parameters(element=all_elements_of_category)
code_block = CodeBlock { {}; }
code_block_2 = CodeBlock { "elem"; }
code_block_3 = CodeBlock { "Type"; }
getParameterValueByName = Element.GetParameterValueByName(element=all_elements_of_category, parameterName=code_block_3)
code_block_4 = CodeBlock { "Type Name"; }
getParameterValueByName_2 = Element.GetParameterValueByName(element=getParameterValueByName, parameterName=code_block_4)
groupByKey = List.GroupByKey(list=all_elements_of_category, keys=getParameterValueByName_2)
byKeysValues = DesignScript.Builtin.Dictionary.ByKeysValues(keys=groupByKey.uniqueKeys, values=groupByKey.groups)
code_block_5 = CodeBlock(i=groupByKey.uniqueKeys) { i[7]; }
valueAtKey = DesignScript.Builtin.Dictionary.ValueAtKey(dictionary=byKeysValues, key=code_block_5)

# group: dictionary 속성 추가
mkNewDict = Python(IN[0]=code_block, IN[1]=code_block_2, IN[2]=valueAtKey)  # CPython3
# ---------- mkNewDict.python (24 lines) ----------
# Load the Python Standard and DesignScript Libraries
import sys
import clr
clr.AddReference('ProtoGeometry')
from Autodesk.DesignScript.Geometry import *

# The inputs to this node will be stored as a list in the IN variables.
dataEnteringNode = IN

preDicts = IN[0]
newKey = IN[1]
newValues = IN[2]

# Place your code below this line

dict_valuePairs = zip(preDicts, newValues)

def mkNewDict(_dict, _key, _value):
    _dict[_key] = _value
    return _dict

result = map(lambda x: mkNewDict(x[0], newKey, x[1]), dict_valuePairs)
# Assign your output to the OUT variable.
OUT = result
# ----------------------------------------

# group: dictionary 생성
byKeysValues_2 = DesignScript.Builtin.Dictionary.ByKeysValues(keys=code_block_2)  # unwired: values
map = List.Map(list=valueAtKey, function=byKeysValues_2)

code_block_6 = CodeBlock { "area"; }
values = DesignScript.Builtin.Dictionary.Values(dictionary=map)
code_block_7 = CodeBlock { "Area"; }
getParameterValueByName_3 = Element.GetParameterValueByName(element=values, parameterName=code_block_7)
flatten = List.Flatten(list=getParameterValueByName_3)

# group: dictionary 속성 추가
mkNewDict_2 = Python(IN[0]=map, IN[1]=code_block_6, IN[2]=flatten)  # CPython3; same code as mkNewDict

code_block_8 = CodeBlock { "srfs"; }
code_block_9 = CodeBlock { "elem"; }
valueAtKey_2 = DesignScript.Builtin.Dictionary.ValueAtKey(dictionary=mkNewDict_2, key=code_block_9)
faces = Element.Faces(element=valueAtKey_2)

# group: dictionary 속성 추가
mkNewDict_3 = Python(IN[0]=mkNewDict_2, IN[1]=code_block_8, IN[2]=faces)  # CPython3; same code as mkNewDict

code_block_10 = CodeBlock(preDict=mkNewDict_3) { preDict; }
code_block_11 = CodeBlock { "side srfs"; }
code_block_12 = CodeBlock { "srfs"; }
valueAtKey_3 = DesignScript.Builtin.Dictionary.ValueAtKey(dictionary=code_block_10, key=code_block_12)

# group: 합성 함수 for side faces_boolmask
code_block_13 = CodeBlock { 0.5; }
normalAtParameter = Surface.NormalAtParameter(u=code_block_13, v=code_block_13)  # unwired: surface
Z = Vector.Z()  # unwired: vector
abs = Math.Abs()  # unwired: number
code_block_14 = CodeBlock { 1; }
ne = _ != code_block_14  # unwired: x
function_compose = ComposeFunctions(function0=normalAtParameter, function1=Z, function2=abs, function3=ne)

map_2 = List.Map(list=valueAtKey_3, function=function_compose)
filterByBoolMask = List.FilterByBoolMask(list=valueAtKey_3, mask=map_2)

# group: dictionary 속성 추가
mkNewDict_4 = Python(IN[0]=code_block_10, IN[1]=code_block_11, IN[2]=filterByBoolMask.in)  # CPython3; same code as mkNewDict

code_block_15 = CodeBlock { "form panel"; }
code_block_16 = CodeBlock { "side srfs"; }
valueAtKey_4 = DesignScript.Builtin.Dictionary.ValueAtKey(dictionary=mkNewDict_4, key=code_block_16)
code_block_17 = CodeBlock { 50; }
code_block_18 = CodeBlock { false; }
thicken = Surface.Thicken(surface=valueAtKey_4, thickness=code_block_17, both_sides=code_block_18)

# group: dictionary 속성 추가
mkNewDict_5 = Python(IN[0]=mkNewDict_4, IN[1]=code_block_15, IN[2]=thicken)  # CPython3; same code as mkNewDict

code_block_19 = CodeBlock { "form panel outface"; }
code_block_20 = CodeBlock { "side srfs"; }
valueAtKey_5 = DesignScript.Builtin.Dictionary.ValueAtKey(dictionary=mkNewDict_5, key=code_block_20)
code_block_21 = CodeBlock { 0.5; }
normalAtParameter_2 = Surface.NormalAtParameter(surface=valueAtKey_5, u=code_block_21, v=code_block_21)
code_block_22 = CodeBlock { 100; }
translate = Geometry.Translate(geometry=valueAtKey_5, direction=normalAtParameter_2, distance=code_block_22)

# group: dictionary 속성 추가
mkNewDict_6 = Python(IN[0]=mkNewDict_5, IN[1]=code_block_19, IN[2]=translate)  # CPython3; same code as mkNewDict

code_block_23 = CodeBlock { "pipe_h"; }
code_block_24 = CodeBlock { "form panel outface"; }
valueAtKey_6 = DesignScript.Builtin.Dictionary.ValueAtKey(dictionary=mkNewDict_6, key=code_block_24)
code_block_25 = CodeBlock { 0.1..0.9..0.2; }
code_block_26 = CodeBlock { 0..1; }
pointAtParameter = Surface.PointAtParameter(surface=valueAtKey_6, u=code_block_25, v=code_block_26, lacing=CrossProduct)
transpose = List.Transpose(lists=pointAtParameter@L3)
firstItem = List.FirstItem(list=transpose@@L2)
lastItem = List.LastItem(list=transpose@@L2)
byStartPointEndPoint = Line.ByStartPointEndPoint(startPoint=firstItem, endPoint=lastItem)
startPoint = Curve.StartPoint(curve=byStartPointEndPoint)
direction = Line.Direction(line=byStartPointEndPoint)
byOriginNormal = Plane.ByOriginNormal(origin=startPoint, normal=direction)
code_block_27 = CodeBlock { 50; }
byPlaneRadius = Circle.ByPlaneRadius(plane=byOriginNormal, radius=code_block_27)
bySweep = Solid.BySweep(profile=byPlaneRadius, path=byStartPointEndPoint)

# group: dictionary 속성 추가
mkNewDict_7 = Python(IN[0]=mkNewDict_6, IN[1]=code_block_23, IN[2]=bySweep)  # CPython3; same code as mkNewDict

code_block_28 = CodeBlock { "pipe_v"; }
code_block_29 = CodeBlock { "form panel outface"; }
valueAtKey_7 = DesignScript.Builtin.Dictionary.ValueAtKey(dictionary=mkNewDict_7, key=code_block_29)
normalAtParameter_3 = Surface.NormalAtParameter(surface=valueAtKey_7)
code_block_30 = CodeBlock { 100; }
translate_2 = Geometry.Translate(geometry=valueAtKey_7, direction=normalAtParameter_3, distance=code_block_30)
code_block_31 = CodeBlock { 0..1; }
code_block_32 = CodeBlock { 0.1..0.9..0.4; }
pointAtParameter_2 = Surface.PointAtParameter(surface=translate_2, u=code_block_31, v=code_block_32, lacing=CrossProduct)
transpose_2 = List.Transpose(lists=pointAtParameter_2@L4)
firstItem_2 = List.FirstItem(list=transpose_2@L3)
lastItem_2 = List.LastItem(list=transpose_2@L3)
byStartPointEndPoint_2 = Line.ByStartPointEndPoint(startPoint=firstItem_2, endPoint=lastItem_2)
startPoint_2 = Curve.StartPoint(curve=byStartPointEndPoint_2)
direction_2 = Line.Direction(line=byStartPointEndPoint_2)
byOriginNormal_2 = Plane.ByOriginNormal(origin=startPoint_2, normal=direction_2)
code_block_33 = CodeBlock { 50; }
byPlaneRadius_2 = Circle.ByPlaneRadius(plane=byOriginNormal_2, radius=code_block_33)
bySweep_2 = Solid.BySweep(profile=byPlaneRadius_2, path=byStartPointEndPoint_2)

# group: dictionary 속성 추가
mkNewDict_8 = Python(IN[0]=mkNewDict_7, IN[1]=code_block_28, IN[2]=bySweep_2)  # CPython3; same code as mkNewDict

code_block_34 = CodeBlock { "form panel"; }
valueAtKey_8 = DesignScript.Builtin.Dictionary.ValueAtKey(dictionary=mkNewDict_7, key=code_block_34)
code_block_35 = CodeBlock(i=valueAtKey_6) { i[0][3]; }
list_create = List.Create()  # unwired: item0, item1
code_block_36 = CodeBlock { 0.1..0.9..0.2; }
code_block_37 = CodeBlock { 0..1; }
cartesianProduct = List.CartesianProduct(combineFunction=list_create, list0=code_block_36, list1=code_block_37)
addItemToFront = List.AddItemToFront(item=valueAtKey_6@@L1, list=cartesianProduct@L2, lacing=CrossProduct)
code_block_38 = CodeBlock { 0; }
getItemAtIndex = List.GetItemAtIndex(list=addItemToFront@@L2, index=code_block_38)
code_block_39 = CodeBlock { 1; }
getItemAtIndex_2 = List.GetItemAtIndex(list=addItemToFront@@L2, index=code_block_39)
code_block_40 = CodeBlock { 2; }
getItemAtIndex_3 = List.GetItemAtIndex(list=addItemToFront@@L2, index=code_block_40)
pointAtParameter_3 = Surface.PointAtParameter(surface=getItemAtIndex, u=getItemAtIndex_2, v=getItemAtIndex_3, lacing=Shortest)
Z_2 = Point.Z()  # unwired: point
groupByFunction = List.GroupByFunction(list=pointAtParameter_3@@L2, groupFunction=Z_2)
firstItem_3 = List.FirstItem(list=groupByFunction@@L2)
lastItem_3 = List.LastItem(list=groupByFunction@@L2)
byStartPointEndPoint_3 = Line.ByStartPointEndPoint(startPoint=firstItem_3, endPoint=lastItem_3, lacing=Shortest)
code_block_41 = CodeBlock(i=mkNewDict_7) { i[0]; }
code_block_42 = CodeBlock { "form panel"; }
valueAtKey_9 = DesignScript.Builtin.Dictionary.ValueAtKey(dictionary=code_block_41, key=code_block_42)
code_block_43 = CodeBlock { "pipe_h"; }
valueAtKey_10 = DesignScript.Builtin.Dictionary.ValueAtKey(dictionary=code_block_41, key=code_block_43)
transpose_3 = List.Transpose(lists=bySweep)
