# Dynamo graph dictionary 활용_거푸집.dyn (Dynamo 2.12.0.5650)

categories = Categories("OST_Walls")
all_elements_of_category = ElementsOfCategory(Category=categories)
parameters = Element.Parameters(element=all_elements_of_category)
code_block = CodeBlock()
# ---------- code_block.designscript (5 lines) ----------
[
"geometry",
"level",
"solid"
];
# ----------------------------------------
byKeysValues = DesignScript.Builtin.Dictionary.ByKeysValues(keys=code_block@L2)  # unwired: values
code_block_2 = CodeBlock { "Type"; }
getParameterValueByName = Element.GetParameterValueByName(element=all_elements_of_category, parameterName=code_block_2)
code_block_3 = CodeBlock { "Type Name"; }
getParameterValueByName_2 = Element.GetParameterValueByName(element=getParameterValueByName, parameterName=code_block_3)
groupByKey = List.GroupByKey(list=all_elements_of_category, keys=getParameterValueByName_2)
byKeysValues_2 = DesignScript.Builtin.Dictionary.ByKeysValues(keys=groupByKey.uniqueKeys, values=groupByKey.groups)
code_block_4 = CodeBlock(i=groupByKey.uniqueKeys) { i[7]; }
valueAtKey = DesignScript.Builtin.Dictionary.ValueAtKey(dictionary=byKeysValues_2, key=code_block_4)
geometry = Element.Geometry(element=valueAtKey)
flatten = List.Flatten(list=geometry)
explode = Geometry.Explode(geometry=flatten)
code_block_5 = CodeBlock { 0.5; }
normalAtParameter = Surface.NormalAtParameter(surface=explode, u=code_block_5, v=code_block_5)
Z = Vector.Z(vector=normalAtParameter)
abs = Math.Abs(number=Z)
code_block_6 = CodeBlock(x=abs) { x != 1; }
filterByBoolMask = List.FilterByBoolMask(list=explode, mask=code_block_6)
code_block_7 = CodeBlock(i=filterByBoolMask.in) { i; }
code_block_8 = CodeBlock { 50; }
code_block_9 = CodeBlock { false; }
thicken = Surface.Thicken(surface=code_block_7, thickness=code_block_8, both_sides=code_block_9)
add = _ + _  # unwired: x, y
code_block_10 = CodeBlock { 0; }
code_block_11 = CodeBlock { "Length"; }
getParameterValueByName_3 = Element.GetParameterValueByName(element=all_elements_of_category, parameterName=code_block_11)
code_block_12 = CodeBlock { "Area"; }
getParameterValueByName_4 = Element.GetParameterValueByName(element=all_elements_of_category, parameterName=code_block_12)
list_create = List.Create(item0=getParameterValueByName_3, item1=getParameterValueByName_4)
transpose = List.Transpose(lists=list_create)
code_block_13 = CodeBlock()
# ---------- code_block_13.designscript (4 lines) ----------
[
"length",
"area"
];
# ----------------------------------------
byKeysValues_3 = DesignScript.Builtin.Dictionary.ByKeysValues(keys=code_block_13)  # unwired: values
map = List.Map(list=transpose, function=byKeysValues_3)
code_block_14 = CodeBlock { "length"; }
valueAtKey_2 = DesignScript.Builtin.Dictionary.ValueAtKey(dictionary=map, key=code_block_14)
reduce = List.Reduce(reduceFunction=add, seed=code_block_10, list0=valueAtKey_2)
code_block_15 = CodeBlock { 1; }
add_2 = _ + code_block_15  # unwired: x
code_block_16 = CodeBlock { 0.1..0.9..0.2; }
code_block_17 = CodeBlock { 0..1; }
pointAtParameter = Surface.PointAtParameter(surface=code_block_7, u=code_block_16, v=code_block_17, lacing=CrossProduct)
transpose_2 = List.Transpose(lists=pointAtParameter@L3)
firstItem = List.FirstItem(list=transpose_2@L2)
lastItem = List.LastItem(list=transpose_2@L2)
byStartPointEndPoint = Line.ByStartPointEndPoint(startPoint=firstItem, endPoint=lastItem)
code_block_18 = CodeBlock { 1; }
count = List.Count(list=valueAtKey)
range = Range(start=code_block_18, end=count)
code_block_19 = CodeBlock(a=range) { "cw"+"-" + a; }
byKeysValues_4 = DesignScript.Builtin.Dictionary.ByKeysValues(keys=code_block_19, values=explode)
components = DesignScript.Builtin.Dictionary.Components(dictionary=byKeysValues_4)
list_create_2 = List.Create()  # unwired: item0, item1
combine = List.Combine(combineFunction=list_create_2, list0=components.values, list1=code_block_6)
transpose_3 = List.Transpose(lists=combine@L3)
code_block_20 = CodeBlock()
# ---------- code_block_20.designscript (4 lines) ----------
[
"Srf",
"bln_side"
];
# ----------------------------------------
byKeysValues_5 = DesignScript.Builtin.Dictionary.ByKeysValues(keys=code_block_20)  # unwired: values
map_2 = List.Map(function=byKeysValues_5)  # unwired: list
map_3 = List.Map(list=transpose_3, function=map_2)
byKeysValues_6 = DesignScript.Builtin.Dictionary.ByKeysValues(keys=components.keys, values=map_3)
