# Dynamo graph dictionary 활용_거푸집_rB.dyn (Dynamo 2.13.1.3887)

categories = Categories("OST_Walls")
all_elements_of_category = ElementsOfCategory(Category=categories)
parameters = Element.Parameters(element=all_elements_of_category)
code_block = CodeBlock { "Type"; }
getParameterValueByName = Element.GetParameterValueByName(element=all_elements_of_category, parameterName=code_block)
code_block_2 = CodeBlock { "Type Name"; }
getParameterValueByName_2 = Element.GetParameterValueByName(element=getParameterValueByName, parameterName=code_block_2)
groupByKey = List.GroupByKey(list=all_elements_of_category, keys=getParameterValueByName_2)
byKeysValues = DesignScript.Builtin.Dictionary.ByKeysValues(keys=groupByKey.uniqueKeys, values=groupByKey.groups)
code_block_3 = CodeBlock(i=groupByKey.uniqueKeys) { i[7]; }
valueAtKey = DesignScript.Builtin.Dictionary.ValueAtKey(dictionary=byKeysValues, key=code_block_3)
geometry = Element.Geometry(element=valueAtKey)
flatten = List.Flatten(list=geometry)
explode = Geometry.Explode(geometry=flatten)
code_block_4 = CodeBlock { 0.5; }
normalAtParameter = Surface.NormalAtParameter(surface=explode, u=code_block_4, v=code_block_4)
Z = Vector.Z(vector=normalAtParameter)
abs = Math.Abs(number=Z)
code_block_5 = CodeBlock(x=abs) { x != 1; }
filterByBoolMask = List.FilterByBoolMask(list=explode, mask=code_block_5)
code_block_6 = CodeBlock(i=filterByBoolMask.in) { i; }
code_block_7 = CodeBlock { 50; }
code_block_8 = CodeBlock { false; }
thicken = Surface.Thicken(surface=code_block_6, thickness=code_block_7, both_sides=code_block_8)
add = _ + _  # unwired: x, y
code_block_9 = CodeBlock { 0; }
code_block_10 = CodeBlock { "Length"; }
getParameterValueByName_3 = Element.GetParameterValueByName(element=all_elements_of_category, parameterName=code_block_10)
code_block_11 = CodeBlock { "Area"; }
getParameterValueByName_4 = Element.GetParameterValueByName(element=all_elements_of_category, parameterName=code_block_11)
list_create = List.Create(item0=getParameterValueByName_3, item1=getParameterValueByName_4)
transpose = List.Transpose(lists=list_create)
code_block_12 = CodeBlock()
# ---------- code_block_12.designscript (4 lines) ----------
[
"length",
"area"
];
# ----------------------------------------
byKeysValues_2 = DesignScript.Builtin.Dictionary.ByKeysValues(keys=code_block_12)  # unwired: values
map = List.Map(list=transpose, function=byKeysValues_2)
code_block_13 = CodeBlock { "length"; }
valueAtKey_2 = DesignScript.Builtin.Dictionary.ValueAtKey(dictionary=map, key=code_block_13)
reduce = List.Reduce(reduceFunction=add, seed=code_block_9, list0=valueAtKey_2)
code_block_14 = CodeBlock { 1; }
add_2 = _ + code_block_14  # unwired: x
code_block_15 = CodeBlock { 0.1..0.9..0.2; }
code_block_16 = CodeBlock { 0..1; }
pointAtParameter = Surface.PointAtParameter(surface=code_block_6, u=code_block_15, v=code_block_16, lacing=CrossProduct)
transpose_2 = List.Transpose(lists=pointAtParameter@L3)
firstItem = List.FirstItem(list=transpose_2@L2)
lastItem = List.LastItem(list=transpose_2@L2)
byStartPointEndPoint = Line.ByStartPointEndPoint(startPoint=firstItem, endPoint=lastItem)
filterByBoolMask_2 = List.FilterByBoolMask()  # unwired: list, mask
code_block_17 = CodeBlock { "srfs"; }

# group: custom dictionary 업데이트(1)
setValueAtKeys = DesignScript.Builtin.Dictionary.SetValueAtKeys(keys=code_block_17)  # unwired: dictionary, values

code_block_18 = CodeBlock { "srfs"; }
valueAtKey_3 = DesignScript.Builtin.Dictionary.ValueAtKey(dictionary=setValueAtKeys, key=code_block_18)

# group: 합성 함수 for side faces_boolmask
code_block_19 = CodeBlock { 0.5; }
normalAtParameter_2 = Surface.NormalAtParameter(u=code_block_19, v=code_block_19)  # unwired: surface
Z_2 = Vector.Z()  # unwired: vector
abs_2 = Math.Abs()  # unwired: number
code_block_20 = CodeBlock { 1; }
ne = _ != code_block_20  # unwired: x
function_compose = ComposeFunctions(function0=normalAtParameter_2, function1=Z_2, function2=abs_2, function3=ne)

map_2 = List.Map(list=valueAtKey_3, function=function_compose)
filterByBoolMask_3 = List.FilterByBoolMask(list=valueAtKey_3, mask=map_2)

# group: custom dictionary 업데이트(1)
code_block_21 = CodeBlock { "side srfs"; }
setValueAtKeys_2 = DesignScript.Builtin.Dictionary.SetValueAtKeys(dictionary=setValueAtKeys, keys=code_block_21, values=filterByBoolMask_3.in)

code_block_22 = CodeBlock { "side srfs"; }
valueAtKey_4 = DesignScript.Builtin.Dictionary.ValueAtKey(dictionary=setValueAtKeys_2, key=code_block_22)
laceShortest = List.LaceShortest()  # unwired: combineFunction, list0, list1

# group: custom dictionary 생성
code_block_23 = CodeBlock { "elem"; }
byKeysValues_3 = DesignScript.Builtin.Dictionary.ByKeysValues(keys=code_block_23)  # unwired: values
map_3 = List.Map(list=valueAtKey, function=byKeysValues_3)

code_block_24 = CodeBlock { "elem"; }
valueAtKey_5 = DesignScript.Builtin.Dictionary.ValueAtKey(dictionary=map_3, key=code_block_24)
faces = Element.Faces(element=valueAtKey_5)
map_4 = List.Map(list=faces, function=setValueAtKeys)
map_5 = List.Map(list=map_3, function=map_4)
