# Dynamo graph dictionary 활용_거푸집_리팩토링후.dyn (Dynamo 2.13.1.3887)

code_block = CodeBlock { {}; }
code_block_2 = CodeBlock { "elem"; }
categories = Categories("OST_Walls")
all_elements_of_category = ElementsOfCategory(Category=categories)
code_block_3 = CodeBlock { "Type"; }
getParameterValueByName = Element.GetParameterValueByName(element=all_elements_of_category, parameterName=code_block_3)
code_block_4 = CodeBlock { "Type Name"; }
getParameterValueByName_2 = Element.GetParameterValueByName(element=getParameterValueByName, parameterName=code_block_4)
groupByKey = List.GroupByKey(list=all_elements_of_category, keys=getParameterValueByName_2)
byKeysValues = DesignScript.Builtin.Dictionary.ByKeysValues(keys=groupByKey.uniqueKeys, values=groupByKey.groups)
code_block_5 = CodeBlock(i=groupByKey.uniqueKeys) { i[7]; }
valueAtKey = DesignScript.Builtin.Dictionary.ValueAtKey(dictionary=byKeysValues, key=code_block_5)
code_block_6 = CodeBlock(preData=valueAtKey) { preData; }

# group: dictionary 속성 추가
mkNewDict = Python(IN[0]=code_block, IN[1]=code_block_2, IN[2]=code_block_6)  # CPython3
# ---------- mkNewDict.python (32 lines) ----------
# Load the Python Standard and DesignScript Libraries
import sys
import clr
clr.AddReference('ProtoGeometry')
from Autodesk.DesignScript.Geometry import *

# The inputs to this node will be stored as a list in the IN variables.
dataEnteringNode = IN

preDicts = IN[0]
newKey = IN[1]
newValues = IN[2]

# Place your code below this line

def mkNewDicts(preDicts, newKey, newValues):
    if preDicts == {}:
        preDicts = []
        list(map(lambda x: preDicts.append({}), newValues))
    else:
        pass

    dict_valuePairs = zip(preDicts, newValues)
    
    def mkNewDict(_dict, _key, _value):
        _dict[_key] = _value
        return _dict
    
    result = map(lambda x: mkNewDict(x[0], newKey, x[1]), dict_valuePairs)
    return result
# Assign your output to the OUT variable.
OUT = mkNewDicts(preDicts, newKey, newValues)
# ----------------------------------------

code_block_7 = CodeBlock { {}; }
code_block_8 = CodeBlock { "elem"; }

# group: dictionary 속성 추가
code_block_9 = CodeBlock(preDict=code_block_7) { preDict; }
list_create = List.Create()  # unwired: item0
map = List.Map(list=code_block_6, function=list_create)
setValueAtKeys = DesignScript.Builtin.Dictionary.SetValueAtKeys(dictionary=code_block_9, keys=code_block_8, values=map, lacing=CrossProduct)

code_block_10 = CodeBlock(preDict=setValueAtKeys) { preDict; }
code_block_11 = CodeBlock { "area"; }
values = DesignScript.Builtin.Dictionary.Values(dictionary=code_block_10)
code_block_12 = CodeBlock { "Area"; }
getParameterValueByName_3 = Element.GetParameterValueByName(element=values, parameterName=code_block_12)
flatten = List.Flatten(list=getParameterValueByName_3)

# group: dictionary 속성 추가
code_block_13 = CodeBlock(preDict=code_block_10) { preDict; }
list_create_2 = List.Create()  # unwired: item0
map_2 = List.Map(list=flatten, function=list_create_2)
setValueAtKeys_2 = DesignScript.Builtin.Dictionary.SetValueAtKeys(dictionary=code_block_13, keys=code_block_11, values=map_2, lacing=CrossProduct)

code_block_14 = CodeBlock(preDict=setValueAtKeys_2) { preDict; }
code_block_15 = CodeBlock { "srfs"; }
code_block_16 = CodeBlock { "elem"; }
valueAtKey_2 = DesignScript.Builtin.Dictionary.ValueAtKey(dictionary=code_block_14, key=code_block_16)
faces = Element.Faces(element=valueAtKey_2)

# group: dictionary 속성 추가
code_block_17 = CodeBlock(preDict=code_block_14) { preDict; }
list_create_3 = List.Create()  # unwired: item0
map_3 = List.Map(list=faces, function=list_create_3)
setValueAtKeys_3 = DesignScript.Builtin.Dictionary.SetValueAtKeys(dictionary=code_block_17, keys=code_block_15, values=map_3, lacing=CrossProduct)

code_block_18 = CodeBlock(preDict=setValueAtKeys_3) { preDict; }
code_block_19 = CodeBlock { "side srfs"; }
code_block_20 = CodeBlock { "srfs"; }
valueAtKey_3 = DesignScript.Builtin.Dictionary.ValueAtKey(dictionary=code_block_18, key=code_block_20)

# group: 합성 함수 for side faces_boolmask
code_block_21 = CodeBlock { 0.5; }
normalAtParameter = Surface.NormalAtParameter(u=code_block_21, v=code_block_21)  # unwired: surface
Z = Vector.Z()  # unwired: vector
abs = Math.Abs()  # unwired: number
code_block_22 = CodeBlock { 1; }
ne = _ != code_block_22  # unwired: x
function_compose = ComposeFunctions(function0=normalAtParameter, function1=Z, function2=abs, function3=ne)

map_4 = List.Map(list=valueAtKey_3, function=function_compose)
filterByBoolMask = List.FilterByBoolMask(list=valueAtKey_3, mask=map_4)

# group: dictionary 속성 추가
code_block_23 = CodeBlock(preDict=code_block_18) { preDict; }
list_create_4 = List.Create()  # unwired: item0
map_5 = List.Map(list=filterByBoolMask.in, function=list_create_4)
setValueAtKeys_4 = DesignScript.Builtin.Dictionary.SetValueAtKeys(dictionary=code_block_23, keys=code_block_19, values=map_5, lacing=CrossProduct)

code_block_24 = CodeBlock(preDict=setValueAtKeys_4) { preDict; }
code_block_25 = CodeBlock { "form panel"; }
code_block_26 = CodeBlock { "side srfs"; }
valueAtKey_4 = DesignScript.Builtin.Dictionary.ValueAtKey(dictionary=code_block_24, key=code_block_26)
code_block_27 = CodeBlock { 50; }
code_block_28 = CodeBlock { false; }
thicken = Surface.Thicken(surface=valueAtKey_4, thickness=code_block_27, both_sides=code_block_28)

# group: dictionary 속성 추가
mkNewDict_2 = Python(IN[0]=code_block_24, IN[1]=code_block_25, IN[2]=thicken)  # CPython3; same code as mkNewDict

code_block_29 = CodeBlock(preDict=mkNewDict_2) { preDict; }
code_block_30 = CodeBlock { "form panel outface"; }
code_block_31 = CodeBlock { "side srfs"; }
valueAtKey_5 = DesignScript.Builtin.Dictionary.ValueAtKey(dictionary=code_block_29, key=code_block_31)
code_block_32 = CodeBlock { 0.5; }
normalAtParameter_2 = Surface.NormalAtParameter(surface=valueAtKey_5, u=code_block_32, v=code_block_32)
code_block_33 = CodeBlock { 100; }
translate = Geometry.Translate(geometry=valueAtKey_5, direction=normalAtParameter_2, distance=code_block_33)

# group: dictionary 속성 추가
mkNewDict_3 = Python(IN[0]=code_block_29, IN[1]=code_block_30, IN[2]=translate)  # CPython3; same code as mkNewDict

code_block_34 = CodeBlock(preDict=mkNewDict_3) { preDict; }
code_block_35 = CodeBlock { "pipe_h"; }
code_block_36 = CodeBlock { "form panel outface"; }
valueAtKey_6 = DesignScript.Builtin.Dictionary.ValueAtKey(dictionary=code_block_34, key=code_block_36)
code_block_37 = CodeBlock { 0.1..0.9..0.2; }
code_block_38 = CodeBlock { 0..1; }
pointAtParameter = Surface.PointAtParameter(surface=valueAtKey_6, u=code_block_37, v=code_block_38, lacing=CrossProduct)
transpose = List.Transpose(lists=pointAtParameter@@L3)
firstItem = List.FirstItem(list=transpose@@L2)
lastItem = List.LastItem(list=transpose@@L2)
byStartPointEndPoint = Line.ByStartPointEndPoint(startPoint=firstItem, endPoint=lastItem)
startPoint = Curve.StartPoint(curve=byStartPointEndPoint)
direction = Line.Direction(line=byStartPointEndPoint)
byOriginNormal = Plane.ByOriginNormal(origin=startPoint, normal=direction)
code_block_39 = CodeBlock { 50; }
byPlaneRadius = Circle.ByPlaneRadius(plane=byOriginNormal, radius=code_block_39)
bySweep = Solid.BySweep(profile=byPlaneRadius, path=byStartPointEndPoint)

# group: dictionary 속성 추가
mkNewDict_4 = Python(IN[0]=code_block_34, IN[1]=code_block_35, IN[2]=bySweep)  # CPython3; same code as mkNewDict

code_block_40 = CodeBlock(preDict=mkNewDict_4) { preDict; }
code_block_41 = CodeBlock { "pipe_v"; }
code_block_42 = CodeBlock { "form panel outface"; }
valueAtKey_7 = DesignScript.Builtin.Dictionary.ValueAtKey(dictionary=code_block_40, key=code_block_42)
normalAtParameter_3 = Surface.NormalAtParameter(surface=valueAtKey_7)
code_block_43 = CodeBlock { 100; }
translate_2 = Geometry.Translate(geometry=valueAtKey_7, direction=normalAtParameter_3, distance=code_block_43)
code_block_44 = CodeBlock { 0..1; }
code_block_45 = CodeBlock { 0.1..0.9..0.4; }
pointAtParameter_2 = Surface.PointAtParameter(surface=translate_2, u=code_block_44, v=code_block_45, lacing=CrossProduct)
transpose_2 = List.Transpose(lists=pointAtParameter_2@@L4)
firstItem_2 = List.FirstItem(list=transpose_2@@L3)
lastItem_2 = List.LastItem(list=transpose_2@@L3)
byStartPointEndPoint_2 = Line.ByStartPointEndPoint(startPoint=firstItem_2, endPoint=lastItem_2)
startPoint_2 = Curve.StartPoint(curve=byStartPointEndPoint_2)
direction_2 = Line.Direction(line=byStartPointEndPoint_2)
byOriginNormal_2 = Plane.ByOriginNormal(origin=startPoint_2, normal=direction_2)
code_block_46 = CodeBlock { 50; }
byPlaneRadius_2 = Circle.ByPlaneRadius(plane=byOriginNormal_2, radius=code_block_46)
bySweep_2 = Solid.BySweep(profile=byPlaneRadius_2, path=byStartPointEndPoint_2)

# group: dictionary 속성 추가
mkNewDict_5 = Python(IN[0]=code_block_40, IN[1]=code_block_41, IN[2]=bySweep_2)  # CPython3; same code as mkNewDict

code_block_47 = CodeBlock(preDict=mkNewDict_5) { preDict; }
integer_slider = IntegerSlider(3, range=0..9 step 1)
code_block_48 = CodeBlock(i=code_block_47, j=integer_slider) { i[j]; }
code_block_49 = CodeBlock { "pipe_h"; }
valueAtKey_8 = DesignScript.Builtin.Dictionary.ValueAtKey(dictionary=code_block_48, key=code_block_49)
code_block_50 = CodeBlock { "pipe_v"; }
valueAtKey_9 = DesignScript.Builtin.Dictionary.ValueAtKey(dictionary=code_block_48, key=code_block_50)
code_block_51 = CodeBlock { "form panel"; }
valueAtKey_10 = DesignScript.Builtin.Dictionary.ValueAtKey(dictionary=code_block_48, key=code_block_51)
code_block_52 = CodeBlock { 120; }
byARGB = Color.ByARGB(alpha=code_block_52, red=code_block_52, blue=code_block_52)
byGeometryColor = Modifiers.GeometryColor.ByGeometryColor(geometry=valueAtKey_10, color=byARGB)
