# Dynamo graph dictionaryNode.dyn (Dynamo 2.13.1.3887)

code_block = CodeBlock()
# ---------- code_block.designscript (3 lines) ----------
["key1",
"key2",
"key3"];
# ----------------------------------------
code_block_2 = CodeBlock()
# ---------- code_block_2.designscript (3 lines) ----------
["value1",
"value2",
"value3"];
# ----------------------------------------
byKeysValues = DesignScript.Builtin.Dictionary.ByKeysValues(keys=code_block, values=code_block_2)
code_block_3 = CodeBlock { "key1"; }
removeKeys = DesignScript.Builtin.Dictionary.RemoveKeys(dictionary=byKeysValues, keys=code_block_3)
code_block_4 = CodeBlock { "key4"; }
code_block_5 = CodeBlock { "value4"; }
setValueAtKeys = DesignScript.Builtin.Dictionary.SetValueAtKeys(dictionary=byKeysValues, keys=code_block_4, values=code_block_5)
python_script = Python()  # CPython3; unwired: IN[0]
# ---------- python_script.python (30 lines) ----------
# Load the Python Standard and DesignScript Libraries
import os
import sys
import re
import clr

python_rootpath = os.getenv('LOCALAPPDATA')+'\Programs\Python'
python_dir_list = os.listdir(python_rootpath)

p = re.compile('Python\d{2,5}')
version_list = list(filter(lambda x: p.match(x), python_dir_list))
version_num = list(map(lambda x: int(x[7:]), version_list))
latest_idx= version_num.index(max(version_num))

python_version = version_list[latest_idx]

sys.path.append(os.getenv('LOCALAPPDATA').replace('\\','\\\\') + f'\Programs\Python\{python_version}\Lib\site-packages')

clr.AddReference('ProtoGeometry')
from Autodesk.DesignScript.Geometry import *

import numpy
import openpyxl
# The inputs to this node will be stored as a list in the IN variables.
dataEnteringNode = IN

# Place your code below this line
dir(sys)
# Assign your output to the OUT variable.
OUT = numpy#(os.environ.get('PYTHONPATH'),  os.environ.get('PATH'))
# ----------------------------------------
