# Dynamo graph bounding box test.dyn (Dynamo 2.16.1.2727)

byCoordinates = Point.ByCoordinates()
code_block = CodeBlock { 10; }
byCoordinates_2 = Point.ByCoordinates(x=code_block, y=code_block, z=code_block)
byCorners = BoundingBox.ByCorners(min=byCoordinates, max=byCoordinates_2)
python_script = Python(IN[0]=byCorners)  # CPython3
# ---------- python_script.python (28 lines) ----------
# Load the Python Standard and DesignScript Libraries
import sys
import clr
clr.AddReference('ProtoGeometry')
from Autodesk.DesignScript.Geometry import *

clr.AddReference('RevitAPI')
from Autodesk.Revit.DB import *
from Autodesk.Revit.DB.Structure import *

clr.AddReference('RevitAPIUI')
from Autodesk.Revit.UI import *

clr.AddReference('System')
from System.Collections.Generic import List

clr.AddReference('RevitNodes')
import Revit
clr.ImportExtensions(Revit.GeometryConversion)
clr.ImportExtensions(Revit.Elements)

# The inputs to this node will be stored as a list in the IN variables.
dataEnteringNode = IN

# Place your code below this line
bbox = IN[0].ToRevitType()
# Assign your output to the OUT variable.
OUT = IN[0], bbox.ToProtoType()
# ----------------------------------------
toCuboid = BoundingBox.ToCuboid(boundingBox=python_script)
