# Dynamo graph Floor Calculator_HEC(0625).dyn "Floor Calculator(0625)" (Dynamo 2.10.1.3976)

# group: Floors
code_block = CodeBlock {  }
code_block_2 = CodeBlock {  }

# group: select all Category element
categories = Categories("OST_Floors")
all_elements_of_category = ElementsOfCategory(Category=categories)
code_block_3 = CodeBlock { "Level"; }
parameterByName = Parameter.ParameterByName(element=all_elements_of_category, name=code_block_3)
string_from_object = FromObject(object=parameterByName)
uniqueItems = List.UniqueItems(list=string_from_object)
code_block_4 = CodeBlock(i=string_from_object, j=uniqueItems) { i == j[0]; }
filterByBoolMask = List.FilterByBoolMask(list=all_elements_of_category, mask=code_block_4)

watch = Watch(filterByBoolMask.in)
watch_2 = Watch(filterByBoolMask.out)

# group: edge 검토 후 진행 - Joint 할때
perimeterCurves = Surface.PerimeterCurves()  # unwired: surface
perimeterCurves_2 = Surface.PerimeterCurves()  # unwired: surface

watch_3 = Watch(all_elements_of_category)

# group: All faces
faces = Element.Faces(element=watch_3)

# group: 하부, 측부 Surface 추출 경사에 따라 Vector 값 범위 확정 필요 [ ] > 확정 후 하부, 측부 분리 > 분리 후 edge 추출 진행 > 분리 후 면적 총합 산출 진행
flatten = List.Flatten(list=faces)
code_block_5 = CodeBlock { 0.5; }
normalAtParameter = Surface.NormalAtParameter(surface=flatten, u=code_block_5, v=code_block_5)
Z = Vector.Z(vector=normalAtParameter@L2)
code_block_6 = CodeBlock(a=Z) { a<0; }
code_block_7 = CodeBlock(a=Z) { a==0; }
filterByBoolMask_2 = List.FilterByBoolMask(list=flatten, mask=code_block_7@L2)
watch_4 = Watch(filterByBoolMask_2.in)
flatten_2 = List.Flatten(list=watch_4)
code_block_8 = CodeBlock(i=Z) { i == 1 ||i == -1? false:true; }
filterByBoolMask_3 = List.FilterByBoolMask(list=flatten, mask=code_block_6@L2)
watch_5 = Watch(filterByBoolMask_3.in)
flatten_3 = List.Flatten(list=watch_5)

countTrue = List.CountTrue(list=code_block_6)
watch_6 = Watch(countTrue)
watch_7 = Watch(flatten_2)
code_block_9 = CodeBlock { 2; }
round = Math.Round(number=Z, digits=code_block_9)
code_block_10 = CodeBlock(a=round) { a==0; a>0; a<0; }
filterByBoolMask_4 = List.FilterByBoolMask(list=flatten, mask=code_block_10.out2@L2)
watch_8 = Watch(filterByBoolMask_4.in)
flatten_4 = List.Flatten(list=watch_8)
flatten_5 = List.Flatten(list=flatten_4)
area = Surface.Area(surface=flatten_5)
sum = Math.Sum(values=area)
watch_9 = Watch(sum)
code_block_11 = CodeBlock(a=Z) { a>0; }
filterByBoolMask_5 = List.FilterByBoolMask(list=flatten, mask=code_block_11@L2)
watch_10 = Watch(filterByBoolMask_5.in)
flatten_6 = List.Flatten(list=watch_10)
filterByBoolMask_6 = List.FilterByBoolMask(list=flatten, mask=code_block_8@L2)
watch_11 = Watch(filterByBoolMask_6.in)
flatten_7 = List.Flatten(list=watch_11)
countTrue_2 = List.CountTrue(list=code_block_8)
watch_12 = Watch(countTrue_2)
countTrue_3 = List.CountTrue(list=code_block_11)
watch_13 = Watch(countTrue_3)
countTrue_4 = List.CountTrue(list=code_block_7)
watch_14 = Watch(countTrue_4)
setDifference = List.SetDifference(list1=flatten_3, list2=flatten_2)
code_block_12 = CodeBlock { 0.5; }
pointAtParameter = Surface.PointAtParameter(surface=flatten_2, u=code_block_12, v=code_block_12)
doesIntersect = Geometry.DoesIntersect(geometry=pointAtParameter, other=flatten_3, lacing=CrossProduct)
watch_15 = Watch(doesIntersect)
filterByBoolMask_7 = List.FilterByBoolMask(mask=watch_15@L2)  # unwired: list
flatten_8 = List.Flatten(list=filterByBoolMask_7.in)
# note: 하부 Surface
perimeterCurves_3 = Surface.PerimeterCurves(surface=flatten_4)
startPoint = Curve.StartPoint(curve=perimeterCurves_3)
boolean = BoolSelector(true)
byPoints = PolyCurve.ByPoints(points=startPoint, connectLastToFirst=boolean)
code_block_13 = CodeBlock { 100; }
offset = Curve.Offset(curve=byPoints, distance=code_block_13)
ZAxis = Vector.ZAxis()
Z_2 = Vector.Z(vector=ZAxis)
watch_16 = Watch(Z_2)
code_block_14 = CodeBlock(z=watch_16) { z>0; }
reverse = Vector.Reverse(vector=ZAxis)
if_ = If(test=code_block_14, true=reverse, false=ZAxis)
code_block_15 = CodeBlock { 1000; }
extrudeAsSolid = Curve.ExtrudeAsSolid(curve=offset, direction=if_, distance=code_block_15)
watch_17 = Watch(reverse)
