# Dynamo graph gd with formular_20210716.dyn (Dynamo 2.10.1.3976)

# group: guide line
code_block = CodeBlock { -40..40..0.1; }
code_block_2 = CodeBlock { 3; 5; }
formula = Formula("(x*x*x*x/10 + a*x*x*x + b*x*x + c*x + d)/200", x=code_block, a=code_block_2.out0, b=code_block_2.out1, c=code_block_2.out0, d=code_block_2.out1)
byCoordinates = Point.ByCoordinates(x=code_block, y=formula, lacing=Shortest)
byControlPoints = NurbsCurve.ByControlPoints(points=byCoordinates)

byCoordinates_2 = Point.ByCoordinates(x=code_block, y=formula)
shuffle = List.Shuffle(list=byCoordinates_2)
Y = Point.Y(point=shuffle)
code_block_3 = CodeBlock { 3; }
round = Math.Round(number=Y, digits=code_block_3)
number_slider = DoubleSlider(-33.2, range=-40..40 step 0.1)  # graph input
code_block_4 = CodeBlock { 3; 5; }
formula_2 = Formula("(x*x*x*x/10 + a*x*x*x + b*x*x + c*x + d)/200", x=number_slider, a=code_block_4.out0, b=code_block_4.out1, c=code_block_4.out0, d=code_block_4.out1)
code_block_5 = CodeBlock { 3; }
round_2 = Math.Round(number=formula_2, digits=code_block_5)
allIndicesOf = List.AllIndicesOf(list=round, item=round_2)
getItemAtIndex = List.GetItemAtIndex(list=shuffle, index=allIndicesOf)
firstItem = List.FirstItem(list=getItemAtIndex)
Y_2 = Point.Y(point=firstItem)  # graph output
