# Dynamo graph 20210921_함수반복.dyn (Dynamo 2.12.0.5650)

byCoordinates = Point.ByCoordinates()
code_block = CodeBlock { 1000; }
byCoordinates_2 = Point.ByCoordinates(y=code_block)
byStartPointEndPoint = Line.ByStartPointEndPoint(startPoint=byCoordinates, endPoint=byCoordinates_2)
integer_slider = IntegerSlider(82, range=0..100 step 1)
python_script = Python(IN[0]=byStartPointEndPoint, IN[1]=integer_slider)  # CPython3; frozen
# ---------- python_script.python (37 lines) ----------
# Python 표준 및 DesignScript 라이브러리 로드
import sys
import clr
clr.AddReference('ProtoGeometry')
from Autodesk.DesignScript.Geometry import *

# 이 노드에 대한 입력값은 IN 변수에 리스트로 저장됩니다.
dataEnteringNode = IN
data_input = IN[0]
repeat = IN[1]
dist = 10

# 코드를 이 선 아래에 배치
def CurveOffset(elem, dist):
    result = Curve.Offset(elem, dist)
    return result

#def RepeatFuncApply(func, repeat, data_input):
#    result = []
#    input_forFunc = data_input
#    while repeat != 0:
#        result.append(func(input_forFunc))
#        input_forFunc = func(input_forFunc)
#        repeat = repeat - 1 
#
#result = RepeatFuncApply(CurveOffset(data_input, dist), repeat, data_input)

result = []
input_forFunc = data_input
while repeat != 0:
    result.append(CurveOffset(input_forFunc, dist))
    input_forFunc = CurveOffset(input_forFunc, dist)
    repeat = repeat - 1


# 출력을 OUT 변수에 지정합니다.
OUT = result
# ----------------------------------------
함수_반복_적용_완성본 = Python(IN[0]=byStartPointEndPoint, IN[1]=integer_slider)  # CPython3
# ---------- 함수_반복_적용_완성본.python (38 lines) ----------
# Python 표준 및 DesignScript 라이브러리 로드
import sys
import clr
clr.AddReference('ProtoGeometry')
from Autodesk.DesignScript.Geometry import *

# 이 노드에 대한 입력값은 IN 변수에 리스트로 저장됩니다.
dataEnteringNode = IN
data_input = IN[0]
repeat = IN[1]
dist = 100

# 코드를 이 선 아래에 배치
def CurveOffset(elem, dist):
    result = Curve.Offset(elem, dist)
    return result

def RepeatFuncApply(func, repeat, data_input):
    result = []
    input_forFunc = data_input
    while repeat != 0:
        result.append(func(input_forFunc))
        input_forFunc = func(input_forFunc)
        repeat = repeat - 1
    return result

result = RepeatFuncApply(lambda x: CurveOffset(x, dist), repeat, data_input)

#result = []
#input_forFunc = data_input
#while repeat != 0:
#    result.append(CurveOffset(input_forFunc, dist))
#    input_forFunc = CurveOffset(input_forFunc, dist)
#    repeat = repeat - 1


# 출력을 OUT 변수에 지정합니다.
OUT = result
# ----------------------------------------
convexHull = Python()  # CPython3; frozen; unwired: IN[0]
# ---------- convexHull.python (60 lines) ----------
# Python 표준 및 DesignScript 라이브러리 로드
import sys
import clr
clr.AddReference('ProtoGeometry')
from Autodesk.DesignScript.Geometry import *

# 이 노드에 대한 입력값은 IN 변수에 리스트로 저장됩니다.
dataEnteringNode = IN
input = IN[0]

class ConvexHull_Maker:
    def __init__(self, points):
        def convex_hull_graham(points):
            def ToVals(pt):
	            return [pt.X,pt.Y,pt.Z]
            def ToPts(ptVals):
	            return Point.ByCoordinates(ptVals[0],ptVals[1],ptVals[2])
	           
            def CreateOutline(pts):
                crvs = []
                i = 0
                while i < len(pts):
                    if i == len(pts)-1:
                        crvs.append(Line.ByStartPointEndPoint(pts[i],pts[0]))
                    else:
                        crvs.append(Line.ByStartPointEndPoint(pts[i],pts[i+1]))
                    i = i+1
                return PolyCurve.ByJoinedCurves(crvs)
	
            TURN_LEFT, TURN_RIGHT, TURN_NONE = (1, -1, 0)

            def cmp(a, b):
                return (a > b) - (a < b)
	
            def turn(p, q, r):
                return cmp((q[0] - p[0])*(r[1] - p[1]) - (r[0] - p[0])*(q[1] - p[1]), 0)
	
            def _keep_left(hull, r):
                while len(hull) > 1 and turn(hull[-2], hull[-1], r) != TURN_LEFT:
                    hull.pop()
                if not len(hull) or hull[-1] != r:
                    hull.append(r)
                return hull

            points = [ToVals(p) for p in points]	
            points = sorted(points)
            l = reduce(_keep_left, points, [])
            u = reduce(_keep_left, reversed(points), [])
            points = l.extend(u[i] for i in range(1, len(u) - 1)) or l
            points = [ToPts(p) for p in points]
            return CreateOutline(points)
            
        self.points = points
        result = convex_hull_graham(points)
        self.result = result

# 코드를 이 선 아래에 배치
result = ConvexHull_Maker(input).result
# 출력을 OUT 변수에 지정합니다.
OUT = result
# ----------------------------------------
code_block_2 = CodeBlock { 1000; 2000; }
byWidthLength = Rectangle.ByWidthLength(width=code_block_2.out0, length=code_block_2.out1)
byPatch = Surface.ByPatch(closedCurve=byWidthLength)

# group: 커브 필렛
explode = Geometry.Explode(geometry=byWidthLength)
code_block_3 = CodeBlock { 2; }
combinations = List.Combinations(list=explode, length=code_block_3)
firstItem = List.FirstItem(list=combinations@L2)
lastItem = List.LastItem(list=combinations@L2)
doesIntersect = Geometry.DoesIntersect(geometry=firstItem, other=lastItem)
filterByBoolMask = List.FilterByBoolMask(list=combinations, mask=doesIntersect)
firstItem_2 = List.FirstItem(list=filterByBoolMask.in@L2)
lastItem_2 = List.LastItem(list=filterByBoolMask.in@L2)
code_block_4 = CodeBlock { 300; }
byFillet = Arc.ByFillet(curve1=firstItem_2, curve2=lastItem_2, radius=code_block_4)

모따기_스플릿_반복적용 = Python(IN[0]=byPatch, IN[1]=byFillet)  # CPython3
# ---------- 모따기_스플릿_반복적용.python (33 lines) ----------
# Python 표준 및 DesignScript 라이브러리 로드
import sys
import clr
clr.AddReference('ProtoGeometry')
from Autodesk.DesignScript.Geometry import *

# 이 노드에 대한 입력값은 IN 변수에 리스트로 저장됩니다.
dataEnteringNode = IN
data_input = IN[0]
others = IN[1]

# 코드를 이 선 아래에 배치
def SplitGeometry(geo, other):
    result = Geometry.Split(geo,other)
    return result

def RepeatFuncApply(func, data_input, others):
#    result = []
    input_forFunc = data_input
    for other in others:
        gtArea = sorted(func(input_forFunc, other), key=lambda x: x.Area)[-1]
#        result.append(gtArea)
        input_forFunc = gtArea

    return gtArea

result = RepeatFuncApply(lambda x,y: SplitGeometry(x, y), data_input, others)

#result = SplitGeometry(data_input, others[0])


# 출력을 OUT 변수에 지정합니다.
OUT = result
# ----------------------------------------
perimeterCurves = Surface.PerimeterCurves(surface=모따기_스플릿_반복적용)
byJoinedCurves = PolyCurve.ByJoinedCurves(curves=perimeterCurves)
code_block_5 = CodeBlock { 100; }
thicken = Surface.Thicken(surface=모따기_스플릿_반복적용, thickness=code_block_5)
number_slider = DoubleSlider(947.3, range=0..999 step 0.1)
byCoordinates_3 = Point.ByCoordinates(y=number_slider)
number_slider_2 = DoubleSlider(997.1, range=0..999 step 0.1)
byCoordinates_4 = Point.ByCoordinates(x=number_slider_2)
byStartPointEndPoint_2 = Line.ByStartPointEndPoint(startPoint=byCoordinates_3, endPoint=byCoordinates_4)
number_slider_3 = DoubleSlider(127.1, range=0..999 step 0.1)
byCoordinates_5 = Point.ByCoordinates(y=number_slider_3)
byStartPointEndPoint_3 = Line.ByStartPointEndPoint(startPoint=byCoordinates_4, endPoint=byCoordinates_5)
byStartPointEndPoint_4 = Line.ByStartPointEndPoint(startPoint=byCoordinates_5, endPoint=byCoordinates_3)
join = List.Join(list0=byCoordinates_4, list1=byCoordinates_3, list2=byCoordinates_5)
byPoints = Polygon.ByPoints(points=join)
byPatch_2 = Surface.ByPatch(closedCurve=byPoints)
code_block_6 = CodeBlock { 300; }
thicken_2 = Surface.Thicken(surface=byPatch_2, thickness=code_block_6)
ZAxis = Vector.ZAxis()
explode_2 = Geometry.Explode(geometry=byPoints)
byJoinedCurves_2 = PolyCurve.ByJoinedCurves(curves=explode_2)
patch = Curve.Patch(curve=byJoinedCurves_2)
code_block_7 = CodeBlock { 100; }
thicken_3 = Surface.Thicken(surface=patch, thickness=code_block_7)
