# Dynamo graph Str Foundation Calculator_DataStructureTest(0916).dyn (Dynamo 2.10.1.3976)

# note: 터파기 물량ㅈ에서 콘크리트, 린 기둥 물량 빼기

# group: Example
code_block = CodeBlock { ["a","b","c"]; [1,2,3]; }
byKeysValues = DesignScript.Builtin.Dictionary.ByKeysValues(keys=code_block.out0, values=code_block.out1)
code_block_2 = CodeBlock { ["d","e","f"]; [4,5,6]; }
byKeysValues_2 = DesignScript.Builtin.Dictionary.ByKeysValues(keys=code_block_2.out0, values=code_block_2.out1)
code_block_3 = CodeBlock(a1=byKeysValues, b1=byKeysValues_2)
# ---------- code_block_3.designscript (4 lines) ----------
{
"a1": a1
,"b1": b1
};
# ----------------------------------------
code_block_4 = CodeBlock { "a1"; }
valueAtKey = DesignScript.Builtin.Dictionary.ValueAtKey(dictionary=code_block_3, key=code_block_4)
code_block_5 = CodeBlock { "a"; }
valueAtKey_2 = DesignScript.Builtin.Dictionary.ValueAtKey(dictionary=valueAtKey, key=code_block_5)

# note: <Func>
createExcavationSolid = Custom[CreateExcavationSolid]()  # CreateExcavationSolidForISOFDN; unwired: Element
createLeanConcrete = Custom[CreateLeanConcrete]()  # CreateLeanConcreteForISOFDN; unwired: Element

# group: Primary Input
categories = Categories("OST_StructuralFoundation")
all_elements_of_category = ElementsOfCategory(Category=categories)
file_path = Filename("..\Latest\BIM_물량집계 자동화 산출기준표_rC(20210903).xlsx")
file_from_path = FileObject(path=file_path)
code_block_6 = CodeBlock { "Str Foundations"; }

# group: GetFull WMCodeDescription PerElement
getFullWMCodeDescriptionPerElement = Custom[GetFullWMCodeDescriptionPerElement](InputElement=all_elements_of_category, InputFilePath=file_from_path, InputSheetName=code_block_6)  # GetFullWMCodeDescriptionPerElement

# group: OrganizeAllElementInformAsDictionary
organizeAllElementInformAsDictionary = Custom[OrganizeAllElementInformAsDictionary](InputDic=getFullWMCodeDescriptionPerElement.Dictionary)  # OrganizeAllElementInformAsDictionary

# group: Select Target Family Element And Connected WorkMasters
code_block_7 = CodeBlock { 0; }
selectTargetFamilyInformAsDictionary = Custom[SelectTargetFamilyInformAsDictionary](InputDic=organizeAllElementInformAsDictionary, InputIndex=code_block_7)  # Select Target Family Element And Connected WorkMasters

# group: Distributer
code_block_8 = CodeBlock(i=selectTargetFamilyInformAsDictionary) { i; }
code_block_9 = CodeBlock(i=code_block_8) { i; }
code_block_10 = CodeBlock(i=code_block_9) { i; }
code_block_11 = CodeBlock(i=code_block_9) { i; }
code_block_12 = CodeBlock(i=code_block_9) { i; }
code_block_13 = CodeBlock(i=code_block_8) { i; }
code_block_14 = CodeBlock(i=code_block_13) { i; }
code_block_15 = CodeBlock(i=code_block_13) { i; }
code_block_16 = CodeBlock(i=code_block_9) { i; }
code_block_17 = CodeBlock(i=code_block_13) { i; }
code_block_18 = CodeBlock(i=code_block_13) { i; }

code_block_19 = CodeBlock { "TargetElements"; }
valueAtKey_3 = DesignScript.Builtin.Dictionary.ValueAtKey(dictionary=code_block_10, key=code_block_19)
createBaseCourseSurfaces = Custom[CreateBaseCourseSurfaces](Element=valueAtKey_3)  # CreateBaseCourseSurfaces
code_block_20 = CodeBlock { "TargetElements"; }
valueAtKey_4 = DesignScript.Builtin.Dictionary.ValueAtKey(dictionary=code_block_11, key=code_block_20)
code_block_21 = CodeBlock(Element=valueAtKey_4) { _Element: var[]..[]; }
code_block_22 = CodeBlock(Element=code_block_21) { _Element; }
faces = Element.Faces(element=code_block_22)
faces_2 = Element.Faces()  # unwired: element
code_block_23 = CodeBlock { 0.5; }
normalAtParameter = Surface.NormalAtParameter(u=code_block_23, v=code_block_23)  # unwired: surface
function_compose = ComposeFunctions(function0=faces_2, function1=normalAtParameter)
function_apply = ApplyFunction(function=function_compose, argument0=code_block_22)
Z = Vector.Z(vector=function_apply)
code_block_24 = CodeBlock { 0; }
round = Math.Round(number=Z, digits=code_block_24)
code_block_25 = CodeBlock(i=round) { i==-1; }
filterByBoolMask = List.FilterByBoolMask(list=faces, mask=code_block_25)
perimeterCurves = Surface.PerimeterCurves(surface=filterByBoolMask.in)
byJoinedCurves = PolyCurve.ByJoinedCurves(curves=perimeterCurves)
code_block_26 = CodeBlock { _leanOffset: var[]..[] = 100; }
offset = Curve.Offset(curve=byJoinedCurves, distance=code_block_26)
byPatch = Surface.ByPatch(closedCurve=offset)
code_block_27 = CodeBlock { _leanThick: var[]..[] = 100; }
boolean = BoolSelector(false)
thicken = Surface.Thicken(surface=byPatch, thickness=code_block_27, both_sides=boolean)

# group: 린 콘크리트 하부까지의 길이 추출 (최하단)
watch = Watch(thicken)
flatten = List.Flatten(list=watch)
byGeometry = BoundingBox.ByGeometry(geom=flatten, lacing=Longest)
maxPoint = BoundingBox.MaxPoint(boundingBox=byGeometry)
Z_2 = Point.Z(point=maxPoint)
watch_2 = Watch(Z_2)
minPoint = BoundingBox.MinPoint(boundingBox=byGeometry)
Z_3 = Point.Z(point=minPoint)
watch_3 = Watch(Z_3)
code_block_28 = CodeBlock(MaxZ=watch_2, MinZ=watch_3) { MaxZ-MinZ; }
watch_4 = Watch(code_block_28)

# group: 린 콘크리트 하부 Surface 추출
watch_5 = Watch(flatten)
code_block_29 = CodeBlock(Solid=watch_5) { _Solid; }
explode = Geometry.Explode(geometry=code_block_29)
explode_2 = Geometry.Explode()  # unwired: geometry
code_block_30 = CodeBlock { 0.5; }
normalAtParameter_2 = Surface.NormalAtParameter(u=code_block_30, v=code_block_30)  # unwired: surface
function_compose_2 = ComposeFunctions(function0=explode_2, function1=normalAtParameter_2)
function_apply_2 = ApplyFunction(function=function_compose_2, argument0=code_block_29)
Z_4 = Vector.Z(vector=function_apply_2)
code_block_31 = CodeBlock { 0; }
round_2 = Math.Round(number=Z_4, digits=code_block_31)
code_block_32 = CodeBlock(i=round_2) { i==-1; }
filterByBoolMask_2 = List.FilterByBoolMask(list=explode, mask=code_block_32)
watch_6 = Watch(filterByBoolMask_2.in)
flatten_2 = List.Flatten(list=watch_6)

perimeterCurves_2 = Surface.PerimeterCurves(surface=flatten_2)
byJoinedCurves_2 = PolyCurve.ByJoinedCurves(curves=perimeterCurves_2)
code_block_33 = CodeBlock { _ExcavOffsetBottom: var[]..[] = 300; }
offset_2 = Curve.Offset(curve=byJoinedCurves_2, distance=code_block_33)
flatten_3 = List.Flatten(list=offset_2)
levels = Levels("G.L")  # graph input
elevation = Level.Elevation(level=levels)
code_block_34 = CodeBlock { "TargetElements"; }
valueAtKey_5 = DesignScript.Builtin.Dictionary.ValueAtKey(dictionary=code_block_12, key=code_block_34)
code_block_35 = CodeBlock(Element=valueAtKey_5) { _Element: var[]..[]; }
code_block_36 = CodeBlock(Element=code_block_35) { _Element; }
code_block_37 = CodeBlock { "Elevation at Bottom"; }
getParameterValueByName = Element.GetParameterValueByName(element=code_block_36, parameterName=code_block_37)
code_block_38 = CodeBlock(기초하단=getParameterValueByName, 린콘크리트하단=watch_4) { 기초하단-린콘크리트하단; }
sub = elevation - code_block_38
code_block_39 = CodeBlock { 0; }
isNull = Object.IsNull()  # unwired: object
replaceByCondition = Replace(item=sub, replaceWith=code_block_39, condition=isNull)
flatten_4 = List.Flatten(list=replaceByCondition)
translate = Geometry.Translate(geometry=offset_2, zTranslation=flatten_4)
경사_비율_입력_1_x = DoubleInput(2)  # graph input
code_block_40 = CodeBlock(ElevationatBottom=flatten_4, 비율=경사_비율_입력_1_x) { ElevationatBottom/비율; }
offset_3 = Curve.Offset(curve=translate, distance=code_block_40)
flatten_5 = List.Flatten(list=offset_3)
list_create = List.Create(item0=flatten_3, item1=flatten_5)
transpose = List.Transpose(lists=list_create)
byLoft = Solid.ByLoft(crossSections=transpose)
watch_7 = Watch(byLoft)
intersect = Geometry.Intersect(geometry=watch_7, other=watch_7, lacing=CrossProduct)
count = List.Count(list=intersect@L2)
code_block_41 = CodeBlock { 6; }
chop = List.Chop(list=count, lengths=code_block_41)
sum = Math.Sum(values=chop)
code_block_42 = CodeBlock(a=sum) { a>1; }
filterByBoolMask_3 = List.FilterByBoolMask(list=watch_7, mask=code_block_42)
watch_8 = Watch(filterByBoolMask_3.in)
isEmpty = List.IsEmpty(list=watch_8)
volume = Solid.Volume(solid=watch_8)
firstItem = List.FirstItem(list=volume)
lastItem = List.LastItem(list=volume)
code_block_43 = CodeBlock(a=firstItem, b=lastItem) { a>b; }
boolean_2 = BoolSelector(true)
allIndicesOf = List.AllIndicesOf(list=code_block_42, item=boolean_2)
lastItem_2 = List.LastItem(list=allIndicesOf)
firstItem_2 = List.FirstItem(list=allIndicesOf)
if_ = If(test=code_block_43, true=lastItem_2, false=firstItem_2)
watch_9 = Watch(if_)
volume_2 = Solid.Volume()  # unwired: solid
minimumItemByKey = List.MinimumItemByKey(list=watch_8, keyFunction=volume_2)
maximumItemByKey = List.MaximumItemByKey(list=watch_8, keyFunction=volume_2)
differenceAll = Solid.DifferenceAll(solid=minimumItemByKey, others=maximumItemByKey)
replaceItemAtIndex = List.ReplaceItemAtIndex(list=watch_7, index=watch_9, item=differenceAll)
if_2 = If(test=isEmpty, true=watch_7, false=replaceItemAtIndex)
color_palette = ColorPalette({R: 210, G: 105, B: 30, A: 135})
byGeometryColor = Modifiers.GeometryColor.ByGeometryColor(geometry=if_2, color=color_palette)
color_palette_2 = ColorPalette({R: 72, G: 209, B: 204, A: 132})
byGeometryColor_2 = Modifiers.GeometryColor.ByGeometryColor(geometry=thicken, color=color_palette_2)
code_block_44 = CodeBlock { "TargetElements"; }
valueAtKey_6 = DesignScript.Builtin.Dictionary.ValueAtKey(dictionary=code_block_14, key=code_block_44)
extractSideFacesOfElement = Custom[ExtractSideFacesOfElement](Element=valueAtKey_6)  # ExtractSideFacesOfElement
code_block_45 = CodeBlock { "TargetElements"; }
valueAtKey_7 = DesignScript.Builtin.Dictionary.ValueAtKey(dictionary=code_block_15, key=code_block_45)
code_block_46 = CodeBlock(Element=valueAtKey_7) { _Element; }
extractUpperFacesOfElement = Custom[ExtractUpperFacesOfElement](Element=code_block_46)  # ExtractUpperFacesOfElement
flatten_6 = List.Flatten(list=extractUpperFacesOfElement.Surface)
getJoinedElements = Element.GetJoinedElements(element=code_block_46)
flatten_7 = List.Flatten(list=getJoinedElements)
extractBelowFacesOfElement = Custom[ExtractBelowFacesOfElement](Element=flatten_7)  # ExtractBelowFacesOfElement
flatten_8 = List.Flatten(list=extractBelowFacesOfElement.Surface)
doesIntersect = Geometry.DoesIntersect(geometry=flatten_8, other=flatten_6, lacing=CrossProduct)
code_block_47 = CodeBlock { true; }
allIndicesOf_2 = List.AllIndicesOf(list=doesIntersect@L2, item=code_block_47)
flatten_9 = List.Flatten(list=allIndicesOf_2)
groupByKey = List.GroupByKey(list=flatten_8, keys=flatten_9)
difference = Surface.Difference(surface=flatten_6, others=groupByKey.groups)
extractSideFacesOfElement_2 = Custom[ExtractSideFacesOfElement](Element=code_block_46)
addItemToFront = List.AddItemToFront(item=difference@L1, list=extractSideFacesOfElement_2.Surface@L2)
color_palette_3 = ColorPalette({R: 30, G: 144, B: 255, A: 129})
byGeometryColor_3 = Modifiers.GeometryColor.ByGeometryColor(geometry=addItemToFront, color=color_palette_3)

# group: See Result
code_block_48 = CodeBlock(SeeResult=createBaseCourseSurfaces.GeometryColor) { SeeResult; }
code_block_49 = CodeBlock(SeeResult=byGeometryColor) { SeeResult; }
code_block_50 = CodeBlock(SeeResult=byGeometryColor_2) { SeeResult; }
code_block_51 = CodeBlock(SeeResult=extractSideFacesOfElement.GeometryColor) { SeeResult; }
code_block_52 = CodeBlock(SeeResult=byGeometryColor_3) { SeeResult; }

# group: Select Target Family Element And Connected WorkMasters
code_block_53 = CodeBlock { 1; }
selectTargetFamilyInformAsDictionary_2 = Custom[SelectTargetFamilyInformAsDictionary](InputDic=organizeAllElementInformAsDictionary, InputIndex=code_block_53)

# group: Distributer
code_block_54 = CodeBlock(i=selectTargetFamilyInformAsDictionary_2) { i; }  # frozen
code_block_55 = CodeBlock(i=code_block_54) { i; }
code_block_56 = CodeBlock(i=code_block_55) { i; }
code_block_57 = CodeBlock(i=code_block_55) { i; }
code_block_58 = CodeBlock(i=code_block_54) { i; }
code_block_59 = CodeBlock(i=code_block_58) { i; }
code_block_60 = CodeBlock(i=code_block_54) { i; }
code_block_61 = CodeBlock(i=code_block_60) { i; }
code_block_62 = CodeBlock(i=code_block_54) { i; }
code_block_63 = CodeBlock(i=code_block_62) { i; }
code_block_64 = CodeBlock(i=code_block_55) { i; }
code_block_65 = CodeBlock(i=code_block_60) { i; }
code_block_66 = CodeBlock(i=code_block_60) { i; }
code_block_67 = CodeBlock(i=code_block_62) { i; }
code_block_68 = CodeBlock(i=code_block_62) { i; }
code_block_69 = CodeBlock(i=code_block_58) { i; }

code_block_70 = CodeBlock { "TargetElements"; }
valueAtKey_8 = DesignScript.Builtin.Dictionary.ValueAtKey(dictionary=code_block_56, key=code_block_70)
extractUpperFacesOfElement_2 = Custom[ExtractUpperFacesOfElement](Element=valueAtKey_8)

# group: <Func 2> - 수정필요
code_block_71 = CodeBlock { "TargetElements"; }
valueAtKey_9 = DesignScript.Builtin.Dictionary.ValueAtKey(dictionary=code_block_57, key=code_block_71)
# note: <Func>
extractSideFacesOfElement_3 = Custom[ExtractSideFacesOfElement](Element=valueAtKey_9)
area = Surface.Area(surface=extractSideFacesOfElement_3.Surface)
sum_2 = Math.Sum(values=area)
code_block_72 = CodeBlock(i=sum_2) { Math.Round(List.Flatten(i)/1000000, 2); }
code_block_73 = CodeBlock { "M2"; }
count_2 = List.Count(list=code_block_72)
ofRepeatedItem = List.OfRepeatedItem(item=code_block_73, amount=count_2)
code_block_74 = CodeBlock(FuncValues=code_block_72, FuncValuesUnit=ofRepeatedItem)
# ---------- code_block_74.designscript (4 lines) ----------
{
"FuncValues": _FuncValues,
"FuncValuesUnit": _FuncValuesUnit
};
# ----------------------------------------

code_block_75 = CodeBlock { "TargetElements"; }
valueAtKey_10 = DesignScript.Builtin.Dictionary.ValueAtKey(dictionary=code_block_59, key=code_block_75)
code_block_76 = CodeBlock { 0; 100; }
createLeanConcrete_2 = Custom[CreateLeanConcrete](Element=valueAtKey_10, leanOffset=code_block_76.out0, leanThick=code_block_76.out1)
code_block_77 = CodeBlock { "TargetElements"; }
valueAtKey_11 = DesignScript.Builtin.Dictionary.ValueAtKey(dictionary=code_block_61, key=code_block_77)
code_block_78 = CodeBlock { 0; }
createExcavationSolid_2 = Custom[CreateExcavationSolid](Element=valueAtKey_11, ExcavOffsetTop=code_block_78, ExcavOffsetBottom=code_block_78)
code_block_79 = CodeBlock { "TargetElements"; }
valueAtKey_12 = DesignScript.Builtin.Dictionary.ValueAtKey(dictionary=code_block_63, key=code_block_79)
createBaseCourseSurfaces_2 = Custom[CreateBaseCourseSurfaces](Element=valueAtKey_12)

# group: See Result
code_block_80 = CodeBlock(SeeResult=extractUpperFacesOfElement_2.GeometryColor) { SeeResult; }
code_block_81 = CodeBlock(SeeResult=extractSideFacesOfElement_3.GeometryColor) { SeeResult; }
code_block_82 = CodeBlock(SeeResult=createLeanConcrete_2.GeometryColor) { SeeResult; }
code_block_83 = CodeBlock(SeeResult=createExcavationSolid_2.GeometryColor) { SeeResult; }
code_block_84 = CodeBlock(SeeResult=createBaseCourseSurfaces_2.GeometryColor) { SeeResult; }

# group: Select Target Family Element And Connected WorkMasters
code_block_85 = CodeBlock { 2; }
selectTargetFamilyInformAsDictionary_3 = Custom[SelectTargetFamilyInformAsDictionary](InputDic=organizeAllElementInformAsDictionary, InputIndex=code_block_85)

# group: Distributer
code_block_86 = CodeBlock(i=selectTargetFamilyInformAsDictionary_3) { i; }  # frozen
code_block_87 = CodeBlock(i=code_block_86) { i; }
code_block_88 = CodeBlock(i=code_block_87) { i; }
code_block_89 = CodeBlock(i=code_block_87) { i; }
code_block_90 = CodeBlock(i=code_block_86) { i; }
code_block_91 = CodeBlock(i=code_block_90) { i; }
code_block_92 = CodeBlock(i=code_block_86) { i; }
code_block_93 = CodeBlock(i=code_block_92) { i; }
code_block_94 = CodeBlock(i=code_block_86) { i; }
code_block_95 = CodeBlock(i=code_block_94) { i; }
code_block_96 = CodeBlock(i=code_block_87) { i; }
code_block_97 = CodeBlock(i=code_block_92) { i; }
code_block_98 = CodeBlock(i=code_block_92) { i; }
code_block_99 = CodeBlock(i=code_block_94) { i; }
code_block_100 = CodeBlock(i=code_block_94) { i; }
code_block_101 = CodeBlock(i=code_block_90) { i; }

code_block_102 = CodeBlock { "TargetElements"; }
valueAtKey_13 = DesignScript.Builtin.Dictionary.ValueAtKey(dictionary=code_block_88, key=code_block_102)
extractUpperFacesOfElement_3 = Custom[ExtractUpperFacesOfElement](Element=valueAtKey_13)

# group: <Func 2> - 수정필요
code_block_103 = CodeBlock { "TargetElements"; }
valueAtKey_14 = DesignScript.Builtin.Dictionary.ValueAtKey(dictionary=code_block_89, key=code_block_103)
# note: <Func>
extractSideFacesOfElement_4 = Custom[ExtractSideFacesOfElement](Element=valueAtKey_14)
area_2 = Surface.Area(surface=extractSideFacesOfElement_4.Surface)
sum_3 = Math.Sum(values=area_2)
code_block_104 = CodeBlock(i=sum_3) { Math.Round(List.Flatten(i)/1000000, 2); }
code_block_105 = CodeBlock { "M2"; }
count_3 = List.Count(list=code_block_104)
ofRepeatedItem_2 = List.OfRepeatedItem(item=code_block_105, amount=count_3)
code_block_106 = CodeBlock(FuncValues=code_block_104, FuncValuesUnit=ofRepeatedItem_2)  # same code as code_block_74

code_block_107 = CodeBlock { "TargetElements"; }
valueAtKey_15 = DesignScript.Builtin.Dictionary.ValueAtKey(dictionary=code_block_91, key=code_block_107)
code_block_108 = CodeBlock { 0; 100; }
createLeanConcrete_3 = Custom[CreateLeanConcrete](Element=valueAtKey_15, leanOffset=code_block_108.out0, leanThick=code_block_108.out1)
code_block_109 = CodeBlock { "TargetElements"; }
valueAtKey_16 = DesignScript.Builtin.Dictionary.ValueAtKey(dictionary=code_block_93, key=code_block_109)
code_block_110 = CodeBlock { 0; }
createExcavationSolid_3 = Custom[CreateExcavationSolid](Element=valueAtKey_16, ExcavOffsetTop=code_block_110, ExcavOffsetBottom=code_block_110)
code_block_111 = CodeBlock { "TargetElements"; }
valueAtKey_17 = DesignScript.Builtin.Dictionary.ValueAtKey(dictionary=code_block_95, key=code_block_111)
createBaseCourseSurfaces_3 = Custom[CreateBaseCourseSurfaces](Element=valueAtKey_17)

# group: See Result
code_block_112 = CodeBlock(SeeResult=extractUpperFacesOfElement_3.GeometryColor) { SeeResult; }
code_block_113 = CodeBlock(SeeResult=extractSideFacesOfElement_4.GeometryColor) { SeeResult; }
code_block_114 = CodeBlock(SeeResult=createLeanConcrete_3.GeometryColor) { SeeResult; }
code_block_115 = CodeBlock(SeeResult=createExcavationSolid_3.GeometryColor) { SeeResult; }
code_block_116 = CodeBlock(SeeResult=createBaseCourseSurfaces_3.GeometryColor) { SeeResult; }

code_block_117 = CodeBlock { "TargetElements"; }
valueAtKey_18 = DesignScript.Builtin.Dictionary.ValueAtKey(dictionary=code_block_16, key=code_block_117)
code_block_118 = CodeBlock { "Volume"; }
getParameterValueByName_2 = Element.GetParameterValueByName(element=valueAtKey_18, parameterName=code_block_118)
code_block_119 = CodeBlock(i=getParameterValueByName_2) { Math.Round(List.Flatten(i)/1, 2); }
code_block_120 = CodeBlock { "M3"; }
count_4 = List.Count(list=code_block_119)
ofRepeatedItem_3 = List.OfRepeatedItem(item=code_block_120, amount=count_4)
code_block_121 = CodeBlock(FuncValues=code_block_119, FuncValuesUnit=ofRepeatedItem_3)  # same code as code_block_74
volume_3 = Solid.Volume(solid=if_2)
code_block_122 = CodeBlock(i=volume_3) { Math.Round(List.Flatten(i)/1000000000, 2); }
code_block_123 = CodeBlock { "M3"; }
count_5 = List.Count(list=code_block_122)
ofRepeatedItem_4 = List.OfRepeatedItem(item=code_block_123, amount=count_5)
code_block_124 = CodeBlock(FuncValues=code_block_122, FuncValuesUnit=ofRepeatedItem_4)  # same code as code_block_74
area_3 = Surface.Area(surface=createBaseCourseSurfaces.Surface)
code_block_125 = CodeBlock(i=area_3) { Math.Round(List.Flatten(i)/1000000, 2); }
code_block_126 = CodeBlock { "M2"; }
count_6 = List.Count(list=code_block_125)
ofRepeatedItem_5 = List.OfRepeatedItem(item=code_block_126, amount=count_6)
code_block_127 = CodeBlock(FuncValues=code_block_125, FuncValuesUnit=ofRepeatedItem_5)  # same code as code_block_74
volume_4 = Solid.Volume(solid=thicken)
code_block_128 = CodeBlock(i=volume_4) { Math.Round(List.Flatten(i)/1000000000, 2); }
code_block_129 = CodeBlock { "M3"; }
count_7 = List.Count(list=code_block_128)
ofRepeatedItem_6 = List.OfRepeatedItem(item=code_block_129, amount=count_7)
code_block_130 = CodeBlock(FuncValues=code_block_128, FuncValuesUnit=ofRepeatedItem_6)  # same code as code_block_74
area_4 = Surface.Area(surface=extractSideFacesOfElement.Surface)
sum_4 = Math.Sum(values=area_4)
code_block_131 = CodeBlock(i=sum_4) { Math.Round(List.Flatten(i)/1000000, 2); }
code_block_132 = CodeBlock { "M2"; }
count_8 = List.Count(list=code_block_131)
ofRepeatedItem_7 = List.OfRepeatedItem(item=code_block_132, amount=count_8)
code_block_133 = CodeBlock(FuncValues=code_block_131, FuncValuesUnit=ofRepeatedItem_7)  # same code as code_block_74
code_block_134 = CodeBlock { "TargetElements"; }
valueAtKey_19 = DesignScript.Builtin.Dictionary.ValueAtKey(dictionary=code_block_17, key=code_block_134)
code_block_135 = CodeBlock { "Volume"; }
getParameterValueByName_3 = Element.GetParameterValueByName(element=valueAtKey_19, parameterName=code_block_135)
철근_비율 = DoubleInput(0.1)  # graph input
mul = getParameterValueByName_3 * 철근_비율
code_block_136 = CodeBlock(i=mul) { Math.Round(List.Flatten(i)/1, 2); }
code_block_137 = CodeBlock { "TON"; }
count_9 = List.Count(list=code_block_136)
ofRepeatedItem_8 = List.OfRepeatedItem(item=code_block_137, amount=count_9)
code_block_138 = CodeBlock(FuncValues=code_block_136, FuncValuesUnit=ofRepeatedItem_8)  # same code as code_block_74
code_block_139 = CodeBlock { "TargetElements"; }
valueAtKey_20 = DesignScript.Builtin.Dictionary.ValueAtKey(dictionary=code_block_18, key=code_block_139)
# note: 린 콘크리 업데이트 필요트
createLeanConcrete_4 = Custom[CreateLeanConcrete](Element=valueAtKey_20)
area_5 = Surface.Area(surface=createLeanConcrete_4.Surface)
code_block_140 = CodeBlock(i=area_5) { Math.Round(List.Flatten(i)/1000000, 2); }
code_block_141 = CodeBlock { "M2"; }
count_10 = List.Count(list=code_block_140)
ofRepeatedItem_9 = List.OfRepeatedItem(item=code_block_141, amount=count_10)
code_block_142 = CodeBlock(FuncValues=code_block_140, FuncValuesUnit=ofRepeatedItem_9)  # same code as code_block_74
area_6 = Surface.Area(surface=addItemToFront)
sum_5 = Math.Sum(values=area_6)
code_block_143 = CodeBlock(i=sum_5) { Math.Round(List.Flatten(i)/1000000, 2); }
code_block_144 = CodeBlock { "M2"; }
count_11 = List.Count(list=code_block_143)
ofRepeatedItem_10 = List.OfRepeatedItem(item=code_block_144, amount=count_11)
code_block_145 = CodeBlock(FuncValues=code_block_143, FuncValuesUnit=ofRepeatedItem_10)  # same code as code_block_74
join = List.Join(list0=code_block_121, list1=code_block_124, list2=code_block_127, list3=code_block_130, list4=code_block_133, list5=code_block_138, list6=code_block_142, list7=code_block_145)

# group: TargetWMunique + Data Sending
code_block_146 = CodeBlock(InputDic2=join) { _InputDic2; }
count_12 = List.Count(list=code_block_146)
code_block_147 = CodeBlock(InputDic1=code_block_8) { _InputDic1; }
code_block_148 = CodeBlock { "TargetWMunique"; }
valueAtKey_21 = DesignScript.Builtin.Dictionary.ValueAtKey(dictionary=code_block_147, key=code_block_148)
watch_10 = Watch(valueAtKey_21)
count_13 = List.Count(list=watch_10)
eq = count_12 == count_13
organizeFuncValuesAndWorkMasterAsDiction = Custom[OrganizeFuncValuesAndWorkMasterAsDictionary](InputDic1=code_block_147, InputDic2=code_block_146)  # Organize FuncValues and WorkMaster As Dictionary
watch_11 = Watch()  # unwired: arg0
if_3 = If(test=eq, true=organizeFuncValuesAndWorkMasterAsDiction, false=watch_11)

# group: 데이터 취합 및 Row 방향 정렬
code_block_149 = CodeBlock(InputDic=if_3) { _InputDic; }
code_block_150 = CodeBlock { "TrTargetFamilyCode"; }
valueAtKey_22 = DesignScript.Builtin.Dictionary.ValueAtKey(dictionary=code_block_149, key=code_block_150)
watch_12 = Watch(valueAtKey_22)
flatten_10 = List.Flatten(list=watch_12)
code_block_151 = CodeBlock { "WMforTargetElements"; }
valueAtKey_23 = DesignScript.Builtin.Dictionary.ValueAtKey(dictionary=code_block_149, key=code_block_151)
watch_13 = Watch(valueAtKey_23)
flatten_11 = List.Flatten(list=watch_13)
code_block_152 = CodeBlock { "TargetFuncValues"; }
valueAtKey_24 = DesignScript.Builtin.Dictionary.ValueAtKey(dictionary=code_block_149, key=code_block_152)
watch_14 = Watch(valueAtKey_24)
flatten_12 = List.Flatten(list=watch_14)
code_block_153 = CodeBlock { "TargetFuncValuesUnit"; }
valueAtKey_25 = DesignScript.Builtin.Dictionary.ValueAtKey(dictionary=code_block_149, key=code_block_153)
watch_15 = Watch(valueAtKey_25)
flatten_13 = List.Flatten(list=watch_15)
list_create_2 = List.Create(item0=flatten_10, item1=flatten_11, item2=flatten_12, item3=flatten_13)
transpose_2 = List.Transpose(lists=list_create_2)

area_7 = Surface.Area(surface=extractUpperFacesOfElement_2.Surface)
sum_6 = Math.Sum(values=area_7)
code_block_154 = CodeBlock(i=sum_6) { Math.Round(List.Flatten(i)/1000000, 2); }
code_block_155 = CodeBlock { "M3"; }
count_14 = List.Count(list=code_block_154)
ofRepeatedItem_11 = List.OfRepeatedItem(item=code_block_155, amount=count_14)
code_block_156 = CodeBlock(FuncValues=code_block_154, FuncValuesUnit=ofRepeatedItem_11)  # same code as code_block_74
code_block_157 = CodeBlock { "TargetElements"; }
valueAtKey_26 = DesignScript.Builtin.Dictionary.ValueAtKey(dictionary=code_block_64, key=code_block_157)
code_block_158 = CodeBlock { "Volume"; }
getParameterValueByName_4 = Element.GetParameterValueByName(element=valueAtKey_26, parameterName=code_block_158)
code_block_159 = CodeBlock(i=getParameterValueByName_4) { Math.Round(List.Flatten(i)/1000000, 2); }
code_block_160 = CodeBlock { "M3"; }
count_15 = List.Count(list=code_block_159)
ofRepeatedItem_12 = List.OfRepeatedItem(item=code_block_160, amount=count_15)
code_block_161 = CodeBlock(FuncValues=code_block_159, FuncValuesUnit=ofRepeatedItem_12)  # same code as code_block_74
code_block_162 = CodeBlock { "TargetElements"; }
valueAtKey_27 = DesignScript.Builtin.Dictionary.ValueAtKey(dictionary=code_block_65, key=code_block_162)
createLeanConcrete_5 = Custom[CreateLeanConcrete](Element=valueAtKey_27)
area_8 = Surface.Area(surface=createLeanConcrete_5.Surface)
code_block_163 = CodeBlock(i=area_8) { Math.Round(List.Flatten(i)/1000000, 2); }
code_block_164 = CodeBlock { "M2"; }
count_16 = List.Count(list=code_block_163)
ofRepeatedItem_13 = List.OfRepeatedItem(item=code_block_164, amount=count_16)
code_block_165 = CodeBlock(FuncValues=code_block_163, FuncValuesUnit=ofRepeatedItem_13)  # same code as code_block_74
map = List.Map()  # unwired: list, function
isNull_2 = Object.IsNull(object=createExcavationSolid_2.Solid)
code_block_166 = CodeBlock { 1; }
mul_2 = _ * code_block_166  # unwired: x
volume_5 = Solid.Volume()  # unwired: solid
if_4 = If(test=isNull_2, true=mul_2, false=volume_5)
code_block_167 = CodeBlock { 0; }
isNull_3 = Object.IsNull()  # unwired: object
replaceByCondition_2 = Replace(item=createExcavationSolid_2.Solid, replaceWith=code_block_167, condition=isNull_3)
laceShortest = List.LaceShortest(combineFunction=map, list0=if_4, list1=replaceByCondition_2)
code_block_168 = CodeBlock(i=laceShortest) { Math.Round(List.Flatten(i)/1000000000, 2); }
code_block_169 = CodeBlock { "M3"; }
count_17 = List.Count(list=code_block_168)
ofRepeatedItem_14 = List.OfRepeatedItem(item=code_block_169, amount=count_17)
code_block_170 = CodeBlock(FuncValues=code_block_168, FuncValuesUnit=ofRepeatedItem_14)  # same code as code_block_74
code_block_171 = CodeBlock { 0; }
code_block_172 = CodeBlock { "TargetElements"; }
valueAtKey_28 = DesignScript.Builtin.Dictionary.ValueAtKey(dictionary=code_block_66, key=code_block_172)
count_18 = List.Count(list=valueAtKey_28@L1)
ofRepeatedItem_15 = List.OfRepeatedItem(item=code_block_171, amount=count_18)
code_block_173 = CodeBlock(i=ofRepeatedItem_15) { Math.Round(List.Flatten(i)/1000000000, 2); }
code_block_174 = CodeBlock { "M3"; }
count_19 = List.Count(list=code_block_173)
ofRepeatedItem_16 = List.OfRepeatedItem(item=code_block_174, amount=count_19)
code_block_175 = CodeBlock(FuncValues=code_block_173, FuncValuesUnit=ofRepeatedItem_16)  # same code as code_block_74
code_block_176 = CodeBlock { 0; }
code_block_177 = CodeBlock { "TargetElements"; }
valueAtKey_29 = DesignScript.Builtin.Dictionary.ValueAtKey(dictionary=code_block_67, key=code_block_177)
count_20 = List.Count(list=valueAtKey_29@L1)
ofRepeatedItem_17 = List.OfRepeatedItem(item=code_block_176, amount=count_20)
code_block_178 = CodeBlock(i=ofRepeatedItem_17) { Math.Round(List.Flatten(i)/1000000000, 2); }
code_block_179 = CodeBlock { "M3"; }
count_21 = List.Count(list=code_block_178)
ofRepeatedItem_18 = List.OfRepeatedItem(item=code_block_179, amount=count_21)
code_block_180 = CodeBlock(FuncValues=code_block_178, FuncValuesUnit=ofRepeatedItem_18)  # same code as code_block_74
area_9 = Surface.Area(surface=createBaseCourseSurfaces_2.Surface)
code_block_181 = CodeBlock(i=area_9) { Math.Round(List.Flatten(i)/1000000, 2); }
code_block_182 = CodeBlock { "M2"; }
count_22 = List.Count(list=code_block_181)
ofRepeatedItem_19 = List.OfRepeatedItem(item=code_block_182, amount=count_22)
code_block_183 = CodeBlock(FuncValues=code_block_181, FuncValuesUnit=ofRepeatedItem_19)  # same code as code_block_74
code_block_184 = CodeBlock { 0; }
code_block_185 = CodeBlock { "TargetElements"; }
valueAtKey_30 = DesignScript.Builtin.Dictionary.ValueAtKey(dictionary=code_block_68, key=code_block_185)
count_23 = List.Count(list=valueAtKey_30@L1)
ofRepeatedItem_20 = List.OfRepeatedItem(item=code_block_184, amount=count_23)
code_block_186 = CodeBlock(i=ofRepeatedItem_20) { Math.Round(List.Flatten(i)/1000000000, 2); }
code_block_187 = CodeBlock { "M3"; }
count_24 = List.Count(list=code_block_186)
ofRepeatedItem_21 = List.OfRepeatedItem(item=code_block_187, amount=count_24)
code_block_188 = CodeBlock(FuncValues=code_block_186, FuncValuesUnit=ofRepeatedItem_21)  # same code as code_block_74
volume_6 = Solid.Volume(solid=createLeanConcrete_2.Solid)
code_block_189 = CodeBlock(i=volume_6) { Math.Round(List.Flatten(i)/1000000000, 2); }
code_block_190 = CodeBlock { "M3"; }
count_25 = List.Count(list=code_block_189)
ofRepeatedItem_22 = List.OfRepeatedItem(item=code_block_190, amount=count_25)
code_block_191 = CodeBlock(FuncValues=code_block_189, FuncValuesUnit=ofRepeatedItem_22)  # same code as code_block_74
code_block_192 = CodeBlock { "TargetElements"; }
valueAtKey_31 = DesignScript.Builtin.Dictionary.ValueAtKey(dictionary=code_block_69, key=code_block_192)
code_block_193 = CodeBlock { "Volume"; }
getParameterValueByName_5 = Element.GetParameterValueByName(element=valueAtKey_31, parameterName=code_block_193)
code_block_194 = CodeBlock { 0.1; }
mul_3 = getParameterValueByName_5 * code_block_194
code_block_195 = CodeBlock(i=mul_3) { Math.Round(List.Flatten(i)/1, 2); }
code_block_196 = CodeBlock { "TON"; }
count_26 = List.Count(list=code_block_195)
ofRepeatedItem_23 = List.OfRepeatedItem(item=code_block_196, amount=count_26)
code_block_197 = CodeBlock(FuncValues=code_block_195, FuncValuesUnit=ofRepeatedItem_23)  # same code as code_block_74
join_2 = List.Join(list0=code_block_156, list1=code_block_161, list2=code_block_74, list3=code_block_165, list4=code_block_170, list5=code_block_175, list6=code_block_180, list7=code_block_183, list8=code_block_188, list9=code_block_191, list10=code_block_197)

# group: TargetWMunique + Data Sending
code_block_198 = CodeBlock(InputDic2=join_2) { _InputDic2; }
count_27 = List.Count(list=code_block_198)
code_block_199 = CodeBlock(InputDic1=code_block_54) { _InputDic1; }
code_block_200 = CodeBlock { "TargetWMunique"; }
valueAtKey_32 = DesignScript.Builtin.Dictionary.ValueAtKey(dictionary=code_block_199, key=code_block_200)
watch_16 = Watch(valueAtKey_32)
count_28 = List.Count(list=watch_16)
eq_2 = count_27 == count_28
organizeFuncValuesAndWorkMasterAsDiction_2 = Custom[OrganizeFuncValuesAndWorkMasterAsDictionary](InputDic1=code_block_199, InputDic2=code_block_198)
watch_17 = Watch()  # unwired: arg0
if_5 = If(test=eq_2, true=organizeFuncValuesAndWorkMasterAsDiction_2, false=watch_17)

# group: 데이터 취합 및 Row 방향 정렬
code_block_201 = CodeBlock(InputDic=if_5) { _InputDic; }
code_block_202 = CodeBlock { "TrTargetFamilyCode"; }
valueAtKey_33 = DesignScript.Builtin.Dictionary.ValueAtKey(dictionary=code_block_201, key=code_block_202)
watch_18 = Watch(valueAtKey_33)
flatten_14 = List.Flatten(list=watch_18)
code_block_203 = CodeBlock { "WMforTargetElements"; }
valueAtKey_34 = DesignScript.Builtin.Dictionary.ValueAtKey(dictionary=code_block_201, key=code_block_203)
watch_19 = Watch(valueAtKey_34)
flatten_15 = List.Flatten(list=watch_19)
code_block_204 = CodeBlock { "TargetFuncValues"; }
valueAtKey_35 = DesignScript.Builtin.Dictionary.ValueAtKey(dictionary=code_block_201, key=code_block_204)
watch_20 = Watch(valueAtKey_35)
flatten_16 = List.Flatten(list=watch_20)
code_block_205 = CodeBlock { "TargetFuncValuesUnit"; }
valueAtKey_36 = DesignScript.Builtin.Dictionary.ValueAtKey(dictionary=code_block_201, key=code_block_205)
watch_21 = Watch(valueAtKey_36)
flatten_17 = List.Flatten(list=watch_21)
list_create_3 = List.Create(item0=flatten_14, item1=flatten_15, item2=flatten_16, item3=flatten_17)
transpose_3 = List.Transpose(lists=list_create_3)

area_10 = Surface.Area(surface=extractUpperFacesOfElement_3.Surface)
sum_7 = Math.Sum(values=area_10)
code_block_206 = CodeBlock(i=sum_7) { Math.Round(List.Flatten(i)/1000000, 2); }
code_block_207 = CodeBlock { "M3"; }
count_29 = List.Count(list=code_block_206)
ofRepeatedItem_24 = List.OfRepeatedItem(item=code_block_207, amount=count_29)
code_block_208 = CodeBlock(FuncValues=code_block_206, FuncValuesUnit=ofRepeatedItem_24)  # same code as code_block_74
code_block_209 = CodeBlock { "TargetElements"; }
valueAtKey_37 = DesignScript.Builtin.Dictionary.ValueAtKey(dictionary=code_block_96, key=code_block_209)
code_block_210 = CodeBlock { "Volume"; }
getParameterValueByName_6 = Element.GetParameterValueByName(element=valueAtKey_37, parameterName=code_block_210)
code_block_211 = CodeBlock(i=getParameterValueByName_6) { Math.Round(List.Flatten(i)/1000000, 2); }
code_block_212 = CodeBlock { "M3"; }
count_30 = List.Count(list=code_block_211)
ofRepeatedItem_25 = List.OfRepeatedItem(item=code_block_212, amount=count_30)
code_block_213 = CodeBlock(FuncValues=code_block_211, FuncValuesUnit=ofRepeatedItem_25)  # same code as code_block_74
code_block_214 = CodeBlock { "TargetElements"; }
valueAtKey_38 = DesignScript.Builtin.Dictionary.ValueAtKey(dictionary=code_block_97, key=code_block_214)
createLeanConcrete_6 = Custom[CreateLeanConcrete](Element=valueAtKey_38)
area_11 = Surface.Area(surface=createLeanConcrete_6.Surface)
code_block_215 = CodeBlock(i=area_11) { Math.Round(List.Flatten(i)/1000000, 2); }
code_block_216 = CodeBlock { "M2"; }
count_31 = List.Count(list=code_block_215)
ofRepeatedItem_26 = List.OfRepeatedItem(item=code_block_216, amount=count_31)
code_block_217 = CodeBlock(FuncValues=code_block_215, FuncValuesUnit=ofRepeatedItem_26)  # same code as code_block_74
map_2 = List.Map()  # unwired: list, function
isNull_4 = Object.IsNull(object=createExcavationSolid_3.Solid)
code_block_218 = CodeBlock { 1; }
mul_4 = _ * code_block_218  # unwired: x
volume_7 = Solid.Volume()  # unwired: solid
if_6 = If(test=isNull_4, true=mul_4, false=volume_7)
code_block_219 = CodeBlock { 0; }
isNull_5 = Object.IsNull()  # unwired: object
replaceByCondition_3 = Replace(item=createExcavationSolid_3.Solid, replaceWith=code_block_219, condition=isNull_5)
laceShortest_2 = List.LaceShortest(combineFunction=map_2, list0=if_6, list1=replaceByCondition_3)
code_block_220 = CodeBlock(i=laceShortest_2) { Math.Round(List.Flatten(i)/1000000000, 2); }
code_block_221 = CodeBlock { "M3"; }
count_32 = List.Count(list=code_block_220)
ofRepeatedItem_27 = List.OfRepeatedItem(item=code_block_221, amount=count_32)
code_block_222 = CodeBlock(FuncValues=code_block_220, FuncValuesUnit=ofRepeatedItem_27)  # same code as code_block_74
code_block_223 = CodeBlock { 0; }
code_block_224 = CodeBlock { "TargetElements"; }
valueAtKey_39 = DesignScript.Builtin.Dictionary.ValueAtKey(dictionary=code_block_98, key=code_block_224)
count_33 = List.Count(list=valueAtKey_39@L1)
ofRepeatedItem_28 = List.OfRepeatedItem(item=code_block_223, amount=count_33)
code_block_225 = CodeBlock(i=ofRepeatedItem_28) { Math.Round(List.Flatten(i)/1000000000, 2); }
code_block_226 = CodeBlock { "M3"; }
count_34 = List.Count(list=code_block_225)
ofRepeatedItem_29 = List.OfRepeatedItem(item=code_block_226, amount=count_34)
code_block_227 = CodeBlock(FuncValues=code_block_225, FuncValuesUnit=ofRepeatedItem_29)  # same code as code_block_74
code_block_228 = CodeBlock { 0; }
code_block_229 = CodeBlock { "TargetElements"; }
valueAtKey_40 = DesignScript.Builtin.Dictionary.ValueAtKey(dictionary=code_block_99, key=code_block_229)
count_35 = List.Count(list=valueAtKey_40@L1)
ofRepeatedItem_30 = List.OfRepeatedItem(item=code_block_228, amount=count_35)
code_block_230 = CodeBlock(i=ofRepeatedItem_30) { Math.Round(List.Flatten(i)/1000000000, 2); }
code_block_231 = CodeBlock { "M3"; }
count_36 = List.Count(list=code_block_230)
ofRepeatedItem_31 = List.OfRepeatedItem(item=code_block_231, amount=count_36)
code_block_232 = CodeBlock(FuncValues=code_block_230, FuncValuesUnit=ofRepeatedItem_31)  # same code as code_block_74
area_12 = Surface.Area(surface=createBaseCourseSurfaces_3.Surface)
code_block_233 = CodeBlock(i=area_12) { Math.Round(List.Flatten(i)/1000000, 2); }
code_block_234 = CodeBlock { "M2"; }
count_37 = List.Count(list=code_block_233)
ofRepeatedItem_32 = List.OfRepeatedItem(item=code_block_234, amount=count_37)
code_block_235 = CodeBlock(FuncValues=code_block_233, FuncValuesUnit=ofRepeatedItem_32)  # same code as code_block_74
code_block_236 = CodeBlock { 0; }
code_block_237 = CodeBlock { "TargetElements"; }
valueAtKey_41 = DesignScript.Builtin.Dictionary.ValueAtKey(dictionary=code_block_100, key=code_block_237)
count_38 = List.Count(list=valueAtKey_41@L1)
ofRepeatedItem_33 = List.OfRepeatedItem(item=code_block_236, amount=count_38)
code_block_238 = CodeBlock(i=ofRepeatedItem_33) { Math.Round(List.Flatten(i)/1000000000, 2); }
code_block_239 = CodeBlock { "M3"; }
count_39 = List.Count(list=code_block_238)
ofRepeatedItem_34 = List.OfRepeatedItem(item=code_block_239, amount=count_39)
code_block_240 = CodeBlock(FuncValues=code_block_238, FuncValuesUnit=ofRepeatedItem_34)  # same code as code_block_74
volume_8 = Solid.Volume(solid=createLeanConcrete_3.Solid)
code_block_241 = CodeBlock(i=volume_8) { Math.Round(List.Flatten(i)/1000000000, 2); }
code_block_242 = CodeBlock { "M3"; }
count_40 = List.Count(list=code_block_241)
ofRepeatedItem_35 = List.OfRepeatedItem(item=code_block_242, amount=count_40)
code_block_243 = CodeBlock(FuncValues=code_block_241, FuncValuesUnit=ofRepeatedItem_35)  # same code as code_block_74
code_block_244 = CodeBlock { "TargetElements"; }
valueAtKey_42 = DesignScript.Builtin.Dictionary.ValueAtKey(dictionary=code_block_101, key=code_block_244)
code_block_245 = CodeBlock { "Volume"; }
getParameterValueByName_7 = Element.GetParameterValueByName(element=valueAtKey_42, parameterName=code_block_245)
code_block_246 = CodeBlock { 0.1; }
mul_5 = getParameterValueByName_7 * code_block_246
code_block_247 = CodeBlock(i=mul_5) { Math.Round(List.Flatten(i)/1, 2); }
code_block_248 = CodeBlock { "TON"; }
count_41 = List.Count(list=code_block_247)
ofRepeatedItem_36 = List.OfRepeatedItem(item=code_block_248, amount=count_41)
code_block_249 = CodeBlock(FuncValues=code_block_247, FuncValuesUnit=ofRepeatedItem_36)  # same code as code_block_74
join_3 = List.Join(list0=code_block_208, list1=code_block_213, list2=code_block_106, list3=code_block_217, list4=code_block_222, list5=code_block_227, list6=code_block_232, list7=code_block_235, list8=code_block_240, list9=code_block_243, list10=code_block_249)

# group: TargetWMunique + Data Sending
code_block_250 = CodeBlock(InputDic2=join_3) { _InputDic2; }
count_42 = List.Count(list=code_block_250)
code_block_251 = CodeBlock(InputDic1=code_block_86) { _InputDic1; }
code_block_252 = CodeBlock { "TargetWMunique"; }
valueAtKey_43 = DesignScript.Builtin.Dictionary.ValueAtKey(dictionary=code_block_251, key=code_block_252)
watch_22 = Watch(valueAtKey_43)
count_43 = List.Count(list=watch_22)
eq_3 = count_42 == count_43
organizeFuncValuesAndWorkMasterAsDiction_3 = Custom[OrganizeFuncValuesAndWorkMasterAsDictionary](InputDic1=code_block_251, InputDic2=code_block_250)
watch_23 = Watch()  # unwired: arg0
if_7 = If(test=eq_3, true=organizeFuncValuesAndWorkMasterAsDiction_3, false=watch_23)

# group: 데이터 취합 및 Row 방향 정렬
code_block_253 = CodeBlock(InputDic=if_7) { _InputDic; }
code_block_254 = CodeBlock { "TrTargetFamilyCode"; }
valueAtKey_44 = DesignScript.Builtin.Dictionary.ValueAtKey(dictionary=code_block_253, key=code_block_254)
watch_24 = Watch(valueAtKey_44)
flatten_18 = List.Flatten(list=watch_24)
code_block_255 = CodeBlock { "WMforTargetElements"; }
valueAtKey_45 = DesignScript.Builtin.Dictionary.ValueAtKey(dictionary=code_block_253, key=code_block_255)
watch_25 = Watch(valueAtKey_45)
flatten_19 = List.Flatten(list=watch_25)
code_block_256 = CodeBlock { "TargetFuncValues"; }
valueAtKey_46 = DesignScript.Builtin.Dictionary.ValueAtKey(dictionary=code_block_253, key=code_block_256)
watch_26 = Watch(valueAtKey_46)
flatten_20 = List.Flatten(list=watch_26)
code_block_257 = CodeBlock { "TargetFuncValuesUnit"; }
valueAtKey_47 = DesignScript.Builtin.Dictionary.ValueAtKey(dictionary=code_block_253, key=code_block_257)
watch_27 = Watch(valueAtKey_47)
flatten_21 = List.Flatten(list=watch_27)
list_create_4 = List.Create(item0=flatten_18, item1=flatten_19, item2=flatten_20, item3=flatten_21)
transpose_4 = List.Transpose(lists=list_create_4)

# group: 패밀리 별 취합 + Export Excel(By OpenpyXl)
# note: Excel Export Button
boolean_3 = BoolSelector(false)
join_4 = List.Join(list0=transpose_2, list1=transpose_3, list2=transpose_4)
watch_28 = Watch()  # unwired: arg0
if_8 = If(test=boolean_3, true=join_4, false=watch_28)
python_script_export_excel_by = Python(IN[0]=if_8)  # "Python Script@Export Excel(By OpenpyXl)"; CPython3
# ---------- python_script_export_excel_by.python (151 lines) ----------
# Load the Python Standard and DesignScript Libraries
import sys
import os
#sys.path.append(r'C:\Users\HEC\AppData\Local\Programs\Python\Python39\Lib\site-packages')
#sys.path.append(r'C:\Users\pjmk0\AppData\Local\Programs\Python\Python39\Lib\site-packages')
sys.path.append(os.getenv('LOCALAPPDATA').replace('\\','\\\\') + r'\Programs\Python\Python39\Lib\site-packages')
import clr
clr.AddReference('ProtoGeometry')
from Autodesk.DesignScript.Geometry import *
from collections import Iterable

def iterable(obj):
    return isinstance(obj, Iterable)


# The inputs to this node will be stored as a list in the IN variables.
dataEnteringNode = IN
ListIn = IN[0]

# Place your code below this line
import datetime
from datetime import date, timedelta
Today = date.today()
import openpyxl
from openpyxl.styles import Border, Side, PatternFill, Font, GradientFill, Alignment, Color, numbers

sample_items = ListIn


def write_to_file(filepath):
    wb = openpyxl.Workbook()
    for sheet in wb.sheetnames:
        wb.remove(wb[sheet])

    thin = Side(border_style="thin", color="000000")
    double = Side(border_style="double", color="000000")

    ws = wb.create_sheet(title='Wall_Calc_instance', index=0)

    ws.merge_cells('A1:L1')
    ws['A1'] = 'HEC Wall Category Calculation Sheet'
    cell = ws['A1']
    cell.font = openpyxl.styles.Font(color='000000', size=20)
    cell.fill = openpyxl.styles.fills.PatternFill(patternType='solid',
                                                  fgColor=openpyxl.styles.colors.Color(rgb='fff3b0'))

    ws['A2'] = 'Item Number'
    ws['A2'].font = openpyxl.styles.Font(b=True, color='000000', size=12)
    #ws['B2'] = 'Member Name'
    #ws['B2'].font = openpyxl.styles.Font(b=True, color='000000', size=12)
    #ws['C2'] = 'Category'
    #ws['C2'].font = openpyxl.styles.Font(b=True, color='000000', size=12)
    ws['B2'] = 'Family Type'
    ws['B2'].font = openpyxl.styles.Font(b=True, color='000000', size=12)
    ws['C2'] = 'WorkMaster Code'
    ws['C2'].font = openpyxl.styles.Font(b=True, color='000000', size=12)
    #ws['F2'] = 'WorkMaster Description'
    #ws['F2'].font = openpyxl.styles.Font(b=True, color='000000', size=12)
    #ws['G2'] = 'Unit'
    #ws['G2'].font = openpyxl.styles.Font(b=True, color='000000', size=12)
    #ws['H2'] = '계수'
    #ws['H2'].font = openpyxl.styles.Font(b=True, color='000000', size=12)
    #ws['I2'] = '계산 참조값'
    #ws['I2'].font = openpyxl.styles.Font(b=True, color='000000', size=12)
    ws['D2'] = 'Quantities'
    ws['D2'].font = openpyxl.styles.Font(b=True, color='000000', size=12)
    ws['E2'] = 'Unit'
    ws['E2'].font = openpyxl.styles.Font(b=True, color='000000', size=12)
    ws['F2'] = 'Unit Price'
    ws['F2'].font = openpyxl.styles.Font(b=True, color='000000', size=12)
    ws['G2'] = 'Total Price'
    ws['G2'].font = openpyxl.styles.Font(b=True, color='000000', size=12)


## 칼럼별 너비 조정 구간
#    for col in range(ws.max_column):
#        ws.column_dimensions[chr(ord('A') + col)].width = 15
    ws.column_dimensions['A'].width = 15
    ws.column_dimensions['B'].width = 45
    ws.column_dimensions['C'].width = 60
    ws.column_dimensions['D'].width = 20
    ws.column_dimensions['E'].width = 20
    ws.column_dimensions['F'].width = 20
    ws.column_dimensions['G'].width = 20
    #ws.column_dimensions['G'].width = 9
    #ws.column_dimensions['H'].width = 9
    #ws.column_dimensions['H'].hidden = True
    #ws.column_dimensions['I'].width = 12
    #ws.column_dimensions['I'].hidden = True
    #ws.column_dimensions['J'].width = 12
    #ws.column_dimensions['K'].width = 12
    #ws.column_dimensions['L'].width = 12

###
    start_row = 3
    for (row, item) in enumerate(sample_items, start_row):
        cell = ws.cell(row=row, column=1, value=row - 2)
        cell.alignment = openpyxl.styles.Alignment(horizontal='center', vertical='center')

#        cell = ws.cell(row=row, column=2, value=item[0])
#        cell.number_format = openpyxl.styles.numbers.FORMAT_DATE_YYYYMMDD2  # 'yyyy-mm-dd'
        ws.cell(row=row, column=2, value=item[0]) ## Family Type 칼럼

        ws.cell(row=row, column=3, value=item[1]) ## WorkMaster Code 칼럼
        
        ws.cell(row=row, column=4, value=item[2]) ## Quantities 칼럼
        
        ws.cell(row=row, column=5, value=item[3]) ## Unit 칼럼
        
        #cell = ws.cell(row=row, column=8, value=item[6]) ## 계수 칼럼
        #cell.number_format = openpyxl.styles.numbers.builtin_format_code(3)  # '#,##0'
        
        #cell = ws.cell(row=row, column=9, value=item[7]) ## 계산 참조값 칼럼
        #cell.number_format = openpyxl.styles.numbers.builtin_format_code(3)  # '#,##0'
        
        #cell = ws.cell(row=row, column=10, value=item[8]) ## Quantities 칼럼
        #cell.number_format = openpyxl.styles.numbers.builtin_format_code(3)  # '#,##0'
        #cell.font = openpyxl.styles.Font(b=True, color='000000', size=11)

        cell = ws.cell(row=row, column=7, value='= D{current_row}*F{current_row}'.format(current_row=cell.row))
        cell.number_format = '#,##0'

#        cell = ws.cell(row=row, column=6, value='= D{current_row} * E{current_row}'.format(current_row=cell.row))
#        cell.number_format = openpyxl.styles.numbers.builtin_format_code(3)

    total_row = ws.max_row + 1
    if total_row > start_row:
        cell1 = ws.cell(row=total_row, column=6, value='Total')
        cell1.font = openpyxl.styles.Font(b=True, color='000000', size=15)
        
        cell2 = ws.cell(row=total_row, column=7, value='= SUM(G{}:G{})'.format(start_row, total_row - 1))
        cell2.number_format = openpyxl.styles.numbers.builtin_format_code(3)
        cell2.border = Border(top=double, left=double, right=double, bottom=double)
        cell2.font = openpyxl.styles.Font(b=True, color='ff03ce', size=15)
    

    wb.save(filepath)
    wb.close()


##if __name__ == '__main__':
#write_to_file('C:\\Users\\pjmk0\\AppData\\Roaming\\test.xlsx')

save_name = "HecStrFDNCalcSheet_" + Today.strftime("%Y-%m-%d")+".xlsx"
path = os.getenv('APPDATA').replace('\\','\\\\')
filePath = path + '\\' + save_name

write_to_file(filePath)

# Assign your output to the OUT variable.
OUT = os.getenv('APPDATA')
# ----------------------------------------

code_block_258 = CodeBlock(ExcavOffsetBottom=code_block_33) { _ExcavOffsetBottom; }
code_block_259 = CodeBlock { GeometryColor; }
code_block_260 = CodeBlock { Solid; }
code_block_261 = CodeBlock { Surface; }

# group: 되메우기
터파기_solid = Watch(if_2)
flatten_22 = List.Flatten(list=터파기_solid)
volume_9 = Solid.Volume(solid=flatten_22)
린_콘크리트_solid = Watch(watch)
flatten_23 = List.Flatten(list=린_콘크리트_solid)
geometry = Element.Geometry(element=code_block_36)
기초_콘크리트_solid = Watch(geometry)
flatten_24 = List.Flatten(list=기초_콘크리트_solid)
categories_2 = Categories("OST_StructuralColumns")
all_elements_of_category_2 = ElementsOfCategory(Category=categories_2)
geometry_2 = Element.Geometry(element=all_elements_of_category_2)
기둥_콘크리트_solid = Watch(geometry_2)
flatten_25 = List.Flatten(list=기둥_콘크리트_solid)
doesIntersect_2 = Geometry.DoesIntersect(geometry=flatten_22, other=flatten_25, lacing=CrossProduct)
filterByBoolMask_4 = List.FilterByBoolMask(list=flatten_25, mask=doesIntersect_2@L2)
기둥_콘크리트_solid_2 = Watch(filterByBoolMask_4.in)
flatten_26 = List.Flatten(list=기둥_콘크리트_solid_2)
list_create_5 = List.Create(item0=flatten_23, item1=flatten_24, item2=flatten_26)
transpose_5 = List.Transpose(lists=list_create_5)
byUnion = Solid.ByUnion(solids=transpose_5)
volume_10 = Solid.Volume(solid=byUnion)
code_block_262 = CodeBlock(터파기볼륨=volume_9, 콘크리트들볼륨=volume_10) { 터파기볼륨 - 콘크리트들볼륨; }
watch_29 = Watch(code_block_262)
code_block_263 = CodeBlock(i=watch_29) { Math.Round(List.Flatten(i)/1000000000, 2); }
code_block_264 = CodeBlock { "M3"; }
count_44 = List.Count(list=watch_29)
ofRepeatedItem_37 = List.OfRepeatedItem(item=code_block_264, amount=count_44)
# note: 되메우기기
code_block_265 = CodeBlock(FuncValues=code_block_263, FuncValuesUnit=ofRepeatedItem_37)  # same code as code_block_74

# group: 잔토처리 1.2 비율
watch_30 = Watch(volume_10)
토량_환산_계수 = DoubleInput(1.2)  # graph input
code_block_266 = CodeBlock(i=watch_30, 토량환산계수=토량_환산_계수) { Math.Round(List.Flatten(i)/1000000000, 2)*토량환산계수; }
code_block_267 = CodeBlock { "M3"; }
count_45 = List.Count(list=watch_30)
ofRepeatedItem_38 = List.OfRepeatedItem(item=code_block_267, amount=count_45)
# note: 잔토처리
code_block_268 = CodeBlock(FuncValues=code_block_266, FuncValuesUnit=ofRepeatedItem_38)  # same code as code_block_74

geometry_3 = Element.Geometry(element=code_block_36)
