# Dynamo graph 20211017_좌표계변환테스트.dyn (Dynamo 2.10.1.3976)

code_block = CodeBlock()
# ---------- code_block.designscript (5 lines) ----------
Point.ByCoordinates(0,0,0);
Point.ByCoordinates(0,10,20);
Point.ByCoordinates(0,20,30);
Point.ByCoordinates(0,30,40);
Point.ByCoordinates(0,40,0);
# ----------------------------------------
join = List.Join(list0=code_block.out0, list1=code_block.out1, list2=code_block.out2, list3=code_block.out3, list4=code_block.out4)
byBestFitThroughPoints = Plane.ByBestFitThroughPoints(points=join)
byPlane = CoordinateSystem.ByPlane(plane=byBestFitThroughPoints)
origin = CoordinateSystem.Origin(coordinateSystem=byPlane)
X = Point.X(point=origin)
Y = Point.Y(point=origin)
Z = Point.Z(point=origin)
code_block_2 = CodeBlock { 0..10..1; }
byCartesianCoordinates = Point.ByCartesianCoordinates(cs=byPlane, x=code_block_2, y=code_block_2, lacing=CrossProduct)
byOrigin = CoordinateSystem.ByOrigin()
transform = Geometry.Transform(geometry=byCartesianCoordinates, fromCoordinateSystem=byPlane, contextCoordinateSystem=byOrigin)
byPoints = PolyCurve.ByPoints(points=transform)
transform_2 = Geometry.Transform(geometry=byPoints, fromCoordinateSystem=byOrigin, contextCoordinateSystem=byPlane)
byOrigin_2 = CoordinateSystem.ByOrigin()
transform_3 = Geometry.Transform(fromCoordinateSystem=byOrigin_2, contextCoordinateSystem=byOrigin_2)  # unwired: geometry
byPoints_2 = NurbsSurface.ByPoints()  # unwired: points
join_2 = List.Join(list0=byCartesianCoordinates, list1=transform)
byPoints_3 = NurbsSurface.ByPoints(points=join_2)
byStartPointEndPoint = Line.ByStartPointEndPoint(startPoint=byCartesianCoordinates, endPoint=transform)
code_block_3 = CodeBlock(i=byStartPointEndPoint) { i[10]; }
normal = Plane.Normal(plane=byBestFitThroughPoints)
mirror = CoordinateSystem.Mirror(coordinateSystem=byPlane, mirrorPlane=byBestFitThroughPoints)
ZAxis = CoordinateSystem.ZAxis(coordinateSystem=mirror)
code_block_4 = CodeBlock { 10; }
byStartPointDirectionLength = Line.ByStartPointDirectionLength(startPoint=origin, direction=ZAxis, length=code_block_4)
