# Dynamo graph 3dconvexhull.dyn (Dynamo 2.12.0.5650)

code_block = CodeBlock { 0..10; 0..5; }
byCoordinates = Point.ByCoordinates(x=code_block.out0, y=code_block.out0, z=code_block.out0, lacing=CrossProduct)
flatten = List.Flatten(list=byCoordinates)
code_block_2 = CodeBlock { 300; }
dropItems = List.DropItems(list=flatten, amount=code_block_2)
byPoints = Tessellation.ConvexHull.ByPoints(points=dropItems)
number_slider = DoubleSlider(2, range=0..53 step 1)
code_block_3 = CodeBlock(i=byPoints, j=number_slider) { i[j]; }
code_block_4 = CodeBlock(i=byPoints) { [i[0]+i[1]+i[2]]; }
