# Dynamo graph 1_Mass Arrangement (by Building List)(1201).dyn (Dynamo 2.10.1.3976)

# group: Data 전처리 구간

# group: Excel Import 구간

# note: select the space planning family with the corresponding parameters to be overwritten by Dynamo
family_types = FamilyTypes("Space Planning Box_hec:Space Planning Box_hec")  # graph input

# group: Input_Excel related
file_path = Filename(".\01_Building List_Pilot Project_2021_1124.xlsx")  # graph input
sheet_name = CodeBlock { "Building List"; }

# group: Github_Python@Import Excel(By OpenpyXl)
string_from_web = Python()  # CPython3; unwired: IN[0]
# ---------- string_from_web.python (19 lines) ----------
# Load the Python Standard and DesignScript Libraries
import sys
import clr
clr.AddReference('ProtoGeometry')
from Autodesk.DesignScript.Geometry import *
import urllib.request

# The inputs to this node will be stored as a list in the IN variables.
dataEnteringNode = IN
inputURL = "https://raw.githubusercontent.com/HNANmal/mQ/master/Laboratory/20211123_%EC%9E%85%EC%B0%B0%EC%9E%90%EB%8F%99%ED%99%94%ED%88%B4Test%20Sample/test.py"

# Place your code below this line
req = urllib.request
data = req.urlopen(inputURL)

result = data.read().decode("utf-8")

# Assign your output to the OUT variable.
OUT = result
# ----------------------------------------
python_script_from_string = PythonStringNode(script=string_from_web, IN[0]=file_path, IN[1]=sheet_name)  # CPython3

# group: 절대좌표 바깥쪽 불필요 데이터 제거
firstItem = List.FirstItem(list=python_script_from_string)
string_from_object = FromObject(object=firstItem)
code_block = CodeBlock { "null"; }
allIndicesOf = List.AllIndicesOf(list=string_from_object, item=code_block)
removeItemAtIndex = List.RemoveItemAtIndex(list=python_script_from_string@L2, indices=allIndicesOf)

# group: 시트 헤더 분리
code_block_2 = CodeBlock { 4; }
getItemAtIndex = List.GetItemAtIndex(list=removeItemAtIndex, index=code_block_2)

# group: 시트 타이틀 및 헤더 제거
code_block_3 = CodeBlock { 1..4; }
removeItemAtIndex_2 = List.RemoveItemAtIndex(list=removeItemAtIndex, indices=code_block_3)

# group: 절대좌표와 Building Name 칼럼 추출
transpose = List.Transpose(lists=removeItemAtIndex_2)
code_block_4 = CodeBlock { "Building Name"; }
firstIndexOf = List.FirstIndexOf(list=getItemAtIndex, item=code_block_4)
code_block_5 = CodeBlock(i=firstIndexOf)
# ---------- code_block_5.designscript (3 lines) ----------
[0,i];
//index[0]은 절대좌표
//index[i]은 Building Name
# ----------------------------------------
getItemAtIndex_2 = List.GetItemAtIndex(list=transpose, index=code_block_5)

# group: 건물별 분리기준 행 추출
string_from_object_2 = FromObject(object=getItemAtIndex_2)
lastItem = List.LastItem(list=string_from_object_2)

# group: 건물별 분리
code_block_6 = CodeBlock { 0; "null"; }
replaceItemAtIndex = List.ReplaceItemAtIndex(list=lastItem, index=code_block_6.out0, item=code_block_6.out1)
code_block_7 = CodeBlock(i=replaceItemAtIndex) { i != "null"; true; }
allIndicesOf_2 = List.AllIndicesOf(list=code_block_7.out0, item=code_block_7.out1)
전체_데이터_by_row = CodeBlock(i=transpose) { i; }
절대좌표_by_row = CodeBlock(i=전체_데이터_by_row) { i[0]; }
count = List.Count(list=절대좌표_by_row)
join = List.Join(list0=allIndicesOf_2, list1=count)
index_finder_건물별_row = Python(IN[0]=join)  # CPython3
# ---------- index_finder_건물별_row.python (22 lines) ----------
# Load the Python Standard and DesignScript Libraries
import sys
import clr
clr.AddReference('ProtoGeometry')
from Autodesk.DesignScript.Geometry import *

# The inputs to this node will be stored as a list in the IN variables.
dataEnteringNode = IN

inputIndex = IN[0]
# Place your code below this line
result = []

for i in range(len(inputIndex)):
    if i+1 < len(inputIndex):
        result.append(range(inputIndex[i], inputIndex[i+1]))
    else:
        pass


# Assign your output to the OUT variable.
OUT = result
# ----------------------------------------
getItemAtIndex_3 = List.GetItemAtIndex(list=transpose@L2, index=index_finder_건물별_row@L2, lacing=CrossProduct)
transpose_2 = List.Transpose(lists=getItemAtIndex_3)

# group: 건물선택
건물별_그룹데이터_by_column = CodeBlock(i=transpose_2) { i; }
code_block_8 = CodeBlock { 3; }
getItemAtIndex_4 = List.GetItemAtIndex(list=건물별_그룹데이터_by_column@L3, index=code_block_8)
firstItem_2 = List.FirstItem(list=getItemAtIndex_4@L2)
건물선택 = StringInput("Central")
contains = String.Contains(str=firstItem_2, searchFor=건물선택)
code_block_9 = CodeBlock { true; }
firstIndexOf_2 = List.FirstIndexOf(list=contains, item=code_block_9)
getItemAtIndex_5 = List.GetItemAtIndex(list=건물별_그룹데이터_by_column, index=firstIndexOf_2)

# group: 불필요 Row 제거
시트_헤더 = CodeBlock(i=getItemAtIndex) { i; }
string_from_object_3 = FromObject(object=시트_헤더)
code_block_10 = CodeBlock { "Room Name"; }
contains_2 = String.Contains(str=string_from_object_3, searchFor=code_block_10)
code_block_11 = CodeBlock { true; }
firstIndexOf_3 = List.FirstIndexOf(list=contains_2, item=code_block_11)
getItemAtIndex_6 = List.GetItemAtIndex(list=getItemAtIndex_5, index=firstIndexOf_3)
string_from_object_4 = FromObject(object=getItemAtIndex_6)
code_block_12 = CodeBlock(i=string_from_object_4) { i=="null"?false:true; true; }
allIndicesOf_3 = List.AllIndicesOf(list=code_block_12.out0, item=code_block_12.out1)
getItemAtIndex_7 = List.GetItemAtIndex(list=getItemAtIndex_5@L2, index=allIndicesOf_3)

# group: header별 데이터 딕셔너리 형성
시트_헤더_2 = CodeBlock(i=getItemAtIndex) { i; }
code_block_13 = CodeBlock { 1; }
list_dropitems_절대좌표제거 = List.DropItems(list=시트_헤더_2, amount=code_block_13)
string_from_object_5 = FromObject(object=list_dropitems_절대좌표제거)
code_block_14 = CodeBlock { 1; }
list_dropitems_절대좌표제거_2 = List.DropItems(list=getItemAtIndex_7, amount=code_block_14)
python_script = Python(IN[0]=string_from_object_5, IN[1]=list_dropitems_절대좌표제거_2)  # CPython3
# ---------- python_script.python (22 lines) ----------
# Load the Python Standard and DesignScript Libraries
import sys
import clr
clr.AddReference('ProtoGeometry')
from Autodesk.DesignScript.Geometry import *

# The inputs to this node will be stored as a list in the IN variables.
dataEnteringNode = IN

inputKeys = IN[0]
inputValues = IN[1]

# Place your code below this line

dict = {}
for i in range(len(inputKeys)):
    dict[inputKeys[i]] = inputValues[i]
    
result = dict

# Assign your output to the OUT variable.
OUT = result
# ----------------------------------------

code_block_15 = CodeBlock(header=string_from_object_5, data=python_script, data_nondic=list_dropitems_절대좌표제거_2)
# ---------- code_block_15.designscript (5 lines) ----------
{
"header": _header,
"data": _data,
"data_nondic": _data_nondic
};
# ----------------------------------------

# group: 속성별 데이터 분류
code_block_16 = CodeBlock(input=code_block_15) { input; }
code_block_17 = CodeBlock(i=code_block_16) { i["data"]; }
code_block_18 = CodeBlock(i=code_block_16) { i["header"]; }
integer_slider = IntegerSlider(9, range=0..70 step 1)
code_block_19 = CodeBlock(i=code_block_18, j=integer_slider) { i[j]; }
watch = Watch(code_block_19)
valueAtKey = DesignScript.Builtin.Dictionary.ValueAtKey(dictionary=code_block_17, key=watch)

# group: Multiplying instances of WIDTH by the QUANTITY column from spreadsheet
code_block_20 = CodeBlock(i=valueAtKey) { i*1000; }
count_2 = List.Count(list=code_block_20@L1)
# note: multiplies each Department
# by the associated value in the
# QUANTITY column from the
# Excel file
ofRepeatedItem = List.OfRepeatedItem(item=code_block_20@L1, amount=count_2@L1)
# note: consolidate all sublist
# groups into one seamless list
flatten = List.Flatten(list=ofRepeatedItem)

# group: 속성별 데이터 분류
code_block_21 = CodeBlock(input=code_block_15) { input; }
code_block_22 = CodeBlock(i=code_block_21) { i["data"]; }
code_block_23 = CodeBlock(i=code_block_21) { i["header"]; }
integer_slider_2 = IntegerSlider(6, range=0..70 step 1)
code_block_24 = CodeBlock(i=code_block_23, j=integer_slider_2) { i[j]; }
watch_2 = Watch(code_block_24)
valueAtKey_2 = DesignScript.Builtin.Dictionary.ValueAtKey(dictionary=code_block_22, key=watch_2)

# group: SORTING: This sequence of creates a new list of sequential unique index number to later be paired with all Department values from the Excel spreadsheet
code_block_25 = CodeBlock { 0; }
# note: flips data to be grouped
# by column not row
# note: select 'Floor'
count_3 = List.Count(list=valueAtKey_2@L1)
# note: multiplies each Department
# by the associated value in the
# QUANTITY column from the
# Excel file
ofRepeatedItem_2 = List.OfRepeatedItem(item=valueAtKey_2@L1, amount=count_3@L1)
# note: consolidate all sublist
# groups into one seamless list
flatten_2 = List.Flatten(list=ofRepeatedItem_2)
# note: From Clockwork package:
# Counts number of times each
# unique item (department) occurs.
# Output:
# 1. list of unique items
# 2. number of occurences
층별_갯수_계산 = CodeBlock(i=flatten_2) { j = List.UniqueItems(i); blnlist = i==j<1>; List.CountTrue(blnlist<1>); }
# note: From LunchBox package:
# Recursive Function -
# adds each item in the list
# to the sum of the values
# before it until the list is
# exhausted.
python_script_2 = Python(IN[0]=층별_갯수_계산.out2)  # IronPython2
# ---------- python_script_2.python (22 lines) ----------
# Load the Python Standard and DesignScript Libraries
import sys
import clr
clr.AddReference('ProtoGeometry')
from Autodesk.DesignScript.Geometry import *

# The inputs to this node will be stored as a list in the IN variables.
dataEnteringNode = IN
inList = IN[0]
outList = []

# Place your code below this line
acc = 0
for i in inList:
	acc = acc + i
	outList.append(acc)
	



# Assign your output to the OUT variable.
OUT = outList
# ----------------------------------------
# note: Adds 0 to the front
# of the list so every
# count starts at 0
addItemToFront = List.AddItemToFront(item=code_block_25, list=python_script_2)
# note: Since 0 is included as an index,
# need to reduce the list by 1 to
# maintain the actual number of
# items
code_block_26 = CodeBlock(x=python_script_2) { x-1; }
# note: Assigns a unique number
#  to each Department
# occurence
code_block_27 = CodeBlock(x=addItemToFront, y=code_block_26) { x..y; }

# note: regroups the Width values
# by Department count
getItemAtIndex_8 = List.GetItemAtIndex(list=flatten, index=code_block_27)
integer_slider_3 = IntegerSlider(20000, range=0..20000 step 5)
code_block_28 = CodeBlock(SPACER=integer_slider_3) { SPACER; }

# group: 속성별 데이터 분류
code_block_29 = CodeBlock(input=code_block_15) { input; }
code_block_30 = CodeBlock(i=code_block_29) { i["data"]; }
code_block_31 = CodeBlock(i=code_block_29) { i["header"]; }
integer_slider_4 = IntegerSlider(10, range=0..70 step 1)
code_block_32 = CodeBlock(i=code_block_31, j=integer_slider_4) { i[j]; }
watch_3 = Watch(code_block_32)
valueAtKey_3 = DesignScript.Builtin.Dictionary.ValueAtKey(dictionary=code_block_30, key=watch_3)

# group: Multiplying instances of LENGTH by the QUANTITY column from spreadsheet
code_block_33 = CodeBlock(i=valueAtKey_3) { i*1000; }
count_4 = List.Count(list=code_block_33@L1)
# note: multiplies each Department
# by the associated value in the
# QUANTITY column from the
# Excel file
ofRepeatedItem_3 = List.OfRepeatedItem(item=code_block_33@L1, amount=count_4@L1)
# note: consolidate all sublist
# groups into one seamless list
flatten_3 = List.Flatten(list=ofRepeatedItem_3)

# note: regroups the Length values
# by Department count
getItemAtIndex_9 = List.GetItemAtIndex(list=flatten_3, index=code_block_27)

# group: SPACING: Using Recursive function to evenly space centroid coordinates based on program widths from spreadsheet.
# note: "helper node":
# re-positioning for
# cleaning up canvas
code_block_34 = CodeBlock(list=getItemAtIndex_8) { list; }
# note: cut all Width values in half
code_block_35 = CodeBlock(a=code_block_34) { a/2; }
code_block_36 = CodeBlock { 1; }
# note: rotate all values in list
# by one position...
# end comes front,
# everything else moves
# down one index
shiftIndices = List.ShiftIndices(list=code_block_35@L2, amount=code_block_36)
# note: buffer: two mapped nodes
# in a row made the second
# function replace an additional
# index... this fixes glitch
code_block_37 = CodeBlock(x=shiftIndices) { x; }
code_block_38 = CodeBlock { 0; }
# note: replace the first item in
# each sublist with 0 as
# starting position for the
# first point
replaceItemAtIndex_2 = List.ReplaceItemAtIndex(list=code_block_37@L2, index=code_block_38, item=code_block_38)
# note: count the number of
# items in every sublist
count_5 = List.Count(list=code_block_34@L2)
# note: Since 0 is included as an index,
# need to reduce the list by 1 to
# maintain the actual number of
# items
code_block_39 = CodeBlock(n=count_5) { n-1; }
# note: copy the spacer value
# as many times as the
# number of items in
# every sublist
ofRepeatedItem_4 = List.OfRepeatedItem(item=code_block_28, amount=code_block_39)
code_block_40 = CodeBlock { 0; }
# note: replace the first item in
# each sublist with 0 so the
# spacing occurs after the
# first instance
insert = List.Insert(list=ofRepeatedItem_4@L2, element=code_block_40, index=code_block_40)
# note: pair the three lists together:
# 1. half the width values from the first item
# 2. half the width values from the next item
# 3. the space value between points
code_block_41 = CodeBlock(a=code_block_35, b=replaceItemAtIndex_2, c=insert) { [a,b,c]; }
# note: these Transpose functions re-sort the sublist so that the values are grouped by individual width values for each point
transpose_3 = List.Transpose(lists=code_block_41)
transpose_4 = List.Transpose(lists=transpose_3@L3)
# note: sum each with sublist
# to get total point distance
sum = Math.Sum(values=transpose_4)
# note: From LunchBox package:
# Recursive Function -
# adds each item in the list
# to the sum of the values
# before it until the list is
# exhausted...
# Spaces each point along the X Axis
python_script_3 = Python(IN[0]=sum)  # IronPython2
# ---------- python_script_3.python (27 lines) ----------
# Load the Python Standard and DesignScript Libraries
import sys
import clr
clr.AddReference('ProtoGeometry')
from Autodesk.DesignScript.Geometry import *

# The inputs to this node will be stored as a list in the IN variables.
dataEnteringNode = IN
inList = IN[0]
outList = []

# Place your code below this line


for i in inList:
	acc = 0
	for j in i:
		acc = acc + j
		outList.append(acc)
#	for j in i:
#		acc = acc + j
#		outList.append([acc])



# Assign your output to the OUT variable.
OUT = outList
# ----------------------------------------
count_6 = List.Count(list=sum@L2)
chop = List.Chop(list=python_script_3, lengths=count_6)
# note: Collect the largest Length value
maximumItem = List.MaximumItem(list=getItemAtIndex_9)
# note: cut all Length values in half
code_block_42 = CodeBlock(a=maximumItem) { [a/2]; }
# note: consolidate all sublist
# groups into one seamless list
flatten_4 = List.Flatten(list=code_block_42)
code_block_43 = CodeBlock { 1; }
shiftIndices_2 = List.ShiftIndices(list=flatten_4, amount=code_block_43)
code_block_44 = CodeBlock { 0; }
# note: replace with 0 as
# starting position for
# the first point
replaceItemAtIndex_3 = List.ReplaceItemAtIndex(list=shiftIndices_2, index=code_block_44, item=code_block_44)
count_7 = List.Count(list=maximumItem)
code_block_45 = CodeBlock(n=count_7) { n-1; }
ofRepeatedItem_5 = List.OfRepeatedItem(item=code_block_28, amount=code_block_45)
code_block_46 = CodeBlock { 0; }
insert_2 = List.Insert(list=ofRepeatedItem_5, element=code_block_46, index=code_block_46)
# note: pair the three lists together:
# 1. half the length values from the first item
# 2. half the length values from the next item
# 3. the space value between points
code_block_47 = CodeBlock(a=flatten_4, b=replaceItemAtIndex_3, c=insert_2) { [a,b,c]; }
# note: this Transpose function re-sorts the sublist so that the values are grouped by individual width values for each point
transpose_5 = List.Transpose(lists=code_block_47)
sum_2 = Math.Sum(values=transpose_5)
python_script_4 = Python(IN[0]=sum_2)  # IronPython2; same code as python_script_2

element_types = ElementTypes("Level")
all_elements_of_type = ElementsOfType(element_type=element_types)
count_8 = List.Count(list=chop@L2)
ofRepeatedItem_6 = List.OfRepeatedItem(item=all_elements_of_type, amount=count_8, lacing=Longest)

# group: INSTANTIATION: Placing Space Planning family at centroid coordinates.
byCoordinates = Point.ByCoordinates(x=chop)
byCoordinates_2 = Vector.ByCoordinates(y=python_script_4)
# note: Create points according to the
# calculated Width values along
# the X Axis...
# Locate the points along the
# Y Axis according to the calculated
# Length values
add = Point.Add(point=byCoordinates@L2, vectorToAdd=byCoordinates_2@L1)
# note: places an instance of the family
# at each point location
byPointAndLevel = FamilyInstance.ByPointAndLevel(familyType=family_types, point=add, level=ofRepeatedItem_6)

# group: 층별 갯수 계산
code_block_48 = CodeBlock { "countByFloor"; }
code_block_49 = CodeBlock(input=code_block_15) { input; }
components = DesignScript.Builtin.Dictionary.Components(dictionary=code_block_49)
addItemToEnd = List.AddItemToEnd(item=code_block_48, list=components.keys)
code_block_50 = CodeBlock(i=code_block_49) { i["data"]; }
code_block_51 = CodeBlock(i=code_block_49) { i["header"]; }
integer_slider_5 = IntegerSlider(6, range=0..70 step 1)
code_block_52 = CodeBlock(i=code_block_51, j=integer_slider_5) { i[j]; }
watch_4 = Watch(code_block_52)
valueAtKey_4 = DesignScript.Builtin.Dictionary.ValueAtKey(dictionary=code_block_50, key=watch_4)
층별_갯수_계산_2 = CodeBlock(i=valueAtKey_4) { j = List.UniqueItems(i); blnlist = i==j<1>; List.CountTrue(blnlist<1>); }
addItemToEnd_2 = List.AddItemToEnd(item=층별_갯수_계산_2.out2, list=components.values)
byKeysValues = DesignScript.Builtin.Dictionary.ByKeysValues(keys=addItemToEnd, values=addItemToEnd_2)

# group: 속성별 데이터 분류-by Grouped as Floor
code_block_53 = CodeBlock(input=byKeysValues) { input; }
code_block_54 = CodeBlock(i=code_block_53) { i["data"]; }
code_block_55 = CodeBlock(i=code_block_53) { i["header"]; }
integer_slider_6 = IntegerSlider(9, range=0..70 step 1)
code_block_56 = CodeBlock(i=code_block_55, j=integer_slider_6) { i[j]; }
watch_5 = Watch(code_block_56)
valueAtKey_5 = DesignScript.Builtin.Dictionary.ValueAtKey(dictionary=code_block_54, key=watch_5)
code_block_57 = CodeBlock(i=code_block_53) { i["countByFloor"]; }
chop_2 = List.Chop(list=valueAtKey_5, lengths=code_block_57)
length = CodeBlock(result=chop_2) { result*1000; }

# group: 속성별 데이터 분류-by Grouped as Floor
code_block_58 = CodeBlock(input=byKeysValues) { input; }
code_block_59 = CodeBlock(i=code_block_58) { i["data"]; }
code_block_60 = CodeBlock(i=code_block_58) { i["header"]; }
integer_slider_7 = IntegerSlider(10, range=0..70 step 1)
code_block_61 = CodeBlock(i=code_block_60, j=integer_slider_7) { i[j]; }
watch_6 = Watch(code_block_61)
valueAtKey_6 = DesignScript.Builtin.Dictionary.ValueAtKey(dictionary=code_block_59, key=watch_6)
code_block_62 = CodeBlock(i=code_block_58) { i["countByFloor"]; }
chop_3 = List.Chop(list=valueAtKey_6, lengths=code_block_62)
length_2 = CodeBlock(result=chop_3) { result*1000; }

# group: 속성별 데이터 분류-by Grouped as Floor
code_block_63 = CodeBlock(input=byKeysValues) { input; }
code_block_64 = CodeBlock(i=code_block_63) { i["data"]; }
code_block_65 = CodeBlock(i=code_block_63) { i["header"]; }
integer_slider_8 = IntegerSlider(14, range=0..70 step 1)
code_block_66 = CodeBlock(i=code_block_65, j=integer_slider_8) { i[j]; }
watch_7 = Watch(code_block_66)
valueAtKey_7 = DesignScript.Builtin.Dictionary.ValueAtKey(dictionary=code_block_64, key=watch_7)
code_block_67 = CodeBlock(i=code_block_63) { i["countByFloor"]; }
chop_4 = List.Chop(list=valueAtKey_7, lengths=code_block_67)
code_block_68 = CodeBlock { 0; }
isNull = Object.IsNull()  # unwired: object
replaceByCondition = Replace(item=chop_4, replaceWith=code_block_68, condition=isNull)
area = CodeBlock(result=replaceByCondition) { result; }

# group: 속성별 데이터 분류-by Grouped as Floor
code_block_69 = CodeBlock(input=byKeysValues) { input; }
code_block_70 = CodeBlock(i=code_block_69) { i["data"]; }
code_block_71 = CodeBlock(i=code_block_69) { i["header"]; }
integer_slider_9 = IntegerSlider(11, range=0..70 step 1)
code_block_72 = CodeBlock(i=code_block_71, j=integer_slider_9) { i[j]; }
watch_8 = Watch(code_block_72)
valueAtKey_8 = DesignScript.Builtin.Dictionary.ValueAtKey(dictionary=code_block_70, key=watch_8)
code_block_73 = CodeBlock(i=code_block_69) { i["countByFloor"]; }
chop_5 = List.Chop(list=valueAtKey_8, lengths=code_block_73)
height = CodeBlock(result=chop_5) { result*1000; }

# group: 속성별 데이터 분류-by Grouped as Floor
code_block_74 = CodeBlock(input=byKeysValues) { input; }
code_block_75 = CodeBlock(i=code_block_74) { i["data"]; }
code_block_76 = CodeBlock(i=code_block_74) { i["header"]; }
integer_slider_10 = IntegerSlider(65, range=0..70 step 1)
code_block_77 = CodeBlock(i=code_block_76, j=integer_slider_10) { i[j]; }
watch_9 = Watch(code_block_77)
valueAtKey_9 = DesignScript.Builtin.Dictionary.ValueAtKey(dictionary=code_block_75, key=watch_9)
code_block_78 = CodeBlock(i=code_block_74) { i["countByFloor"]; }
chop_6 = List.Chop(list=valueAtKey_9, lengths=code_block_78)
dicipline = CodeBlock(result=chop_6) { result; }

# group: 속성별 데이터 분류-by Grouped as Floor @ Int. Wall Finish
code_block_79 = CodeBlock { ".."; }
code_block_80 = CodeBlock(input=byKeysValues) { input; }
code_block_81 = CodeBlock(i=code_block_80) { i["data_nondic"]; }
code_block_82 = CodeBlock(i=code_block_80) { i["header"]; }
code_block_83 = CodeBlock { "Int."; }
contains_3 = String.Contains(str=code_block_82, searchFor=code_block_83)
code_block_84 = CodeBlock { true; }
allIndicesOf_4 = List.AllIndicesOf(list=contains_3, item=code_block_84)
getItemAtIndex_10 = List.GetItemAtIndex(list=code_block_81, index=allIndicesOf_4)
getItemAtIndex_11 = List.GetItemAtIndex(list=code_block_82, index=allIndicesOf_4)
code_block_85 = CodeBlock { "Wall"; }
contains_4 = String.Contains(str=getItemAtIndex_11, searchFor=code_block_85)
code_block_86 = CodeBlock { true; }
allIndicesOf_5 = List.AllIndicesOf(list=contains_4, item=code_block_86)
getItemAtIndex_12 = List.GetItemAtIndex(list=getItemAtIndex_10, index=allIndicesOf_5)
transpose_6 = List.Transpose(lists=getItemAtIndex_12)
join_2 = String.Join(separator=code_block_79, string0=transpose_6@L2)
code_block_87 = CodeBlock { "N/A"; }
isNull_2 = Object.IsNull()  # unwired: object
replaceByCondition_2 = Replace(item=getItemAtIndex_12, replaceWith=code_block_87, condition=isNull_2)

# group: string 검사
code_block_88 = CodeBlock(input=join_2) { input; }
code_block_89 = CodeBlock { ".."; }
endsWith = String.EndsWith(str=code_block_88, searchFor=code_block_89)
code_block_90 = CodeBlock { -1; }
code_block_91 = CodeBlock { -2; }
remove = String.Remove(string=code_block_88, startIndex=code_block_90, count=code_block_91)
if_ = If(test=endsWith, true=remove, false=code_block_88)

# group: 속성별 데이터 분류-by Grouped as Floor @ Int. Base Finish
code_block_92 = CodeBlock { ".."; }
code_block_93 = CodeBlock(input=byKeysValues) { input; }
code_block_94 = CodeBlock(i=code_block_93) { i["data_nondic"]; }
code_block_95 = CodeBlock(i=code_block_93) { i["header"]; }
code_block_96 = CodeBlock { "Int."; }
contains_5 = String.Contains(str=code_block_95, searchFor=code_block_96)
code_block_97 = CodeBlock { true; }
allIndicesOf_6 = List.AllIndicesOf(list=contains_5, item=code_block_97)
getItemAtIndex_13 = List.GetItemAtIndex(list=code_block_94, index=allIndicesOf_6)
getItemAtIndex_14 = List.GetItemAtIndex(list=code_block_95, index=allIndicesOf_6)
code_block_98 = CodeBlock { "Base"; }
contains_6 = String.Contains(str=getItemAtIndex_14, searchFor=code_block_98)
code_block_99 = CodeBlock { true; }
allIndicesOf_7 = List.AllIndicesOf(list=contains_6, item=code_block_99)
getItemAtIndex_15 = List.GetItemAtIndex(list=getItemAtIndex_13, index=allIndicesOf_7)
transpose_7 = List.Transpose(lists=getItemAtIndex_15)
join_3 = String.Join(separator=code_block_92, string0=transpose_7@L2)
code_block_100 = CodeBlock { "N/A"; }
isNull_3 = Object.IsNull()  # unwired: object
replaceByCondition_3 = Replace(item=getItemAtIndex_15, replaceWith=code_block_100, condition=isNull_3)

# group: string 검사
code_block_101 = CodeBlock(input=join_3) { input; }
code_block_102 = CodeBlock { ".."; }
endsWith_2 = String.EndsWith(str=code_block_101, searchFor=code_block_102)
code_block_103 = CodeBlock { -1; }
code_block_104 = CodeBlock { -2; }
remove_2 = String.Remove(string=code_block_101, startIndex=code_block_103, count=code_block_104)
if_2 = If(test=endsWith_2, true=remove_2, false=code_block_101)

# group: 속성별 데이터 분류-by Grouped as Floor @ Int. Floor Finish
code_block_105 = CodeBlock { ".."; }
code_block_106 = CodeBlock(input=byKeysValues) { input; }
code_block_107 = CodeBlock(i=code_block_106) { i["data_nondic"]; }
code_block_108 = CodeBlock(i=code_block_106) { i["header"]; }
code_block_109 = CodeBlock { "Int."; }
contains_7 = String.Contains(str=code_block_108, searchFor=code_block_109)
code_block_110 = CodeBlock { true; }
allIndicesOf_8 = List.AllIndicesOf(list=contains_7, item=code_block_110)
getItemAtIndex_16 = List.GetItemAtIndex(list=code_block_107, index=allIndicesOf_8)
getItemAtIndex_17 = List.GetItemAtIndex(list=code_block_108, index=allIndicesOf_8)
code_block_111 = CodeBlock { "Floor"; }
contains_8 = String.Contains(str=getItemAtIndex_17, searchFor=code_block_111)
code_block_112 = CodeBlock { true; }
allIndicesOf_9 = List.AllIndicesOf(list=contains_8, item=code_block_112)
getItemAtIndex_18 = List.GetItemAtIndex(list=getItemAtIndex_16, index=allIndicesOf_9)
transpose_8 = List.Transpose(lists=getItemAtIndex_18)
join_4 = String.Join(separator=code_block_105, string0=transpose_8@L2)
code_block_113 = CodeBlock { "N/A"; }
isNull_4 = Object.IsNull()  # unwired: object
replaceByCondition_4 = Replace(item=getItemAtIndex_18, replaceWith=code_block_113, condition=isNull_4)

# group: string 검사
code_block_114 = CodeBlock(input=join_4) { input; }
code_block_115 = CodeBlock { ".."; }
endsWith_3 = String.EndsWith(str=code_block_114, searchFor=code_block_115)
code_block_116 = CodeBlock { -1; }
code_block_117 = CodeBlock { -2; }
remove_3 = String.Remove(string=code_block_114, startIndex=code_block_116, count=code_block_117)
if_3 = If(test=endsWith_3, true=remove_3, false=code_block_114)

# group: 속성별 데이터 분류-by Grouped as Floor @ Int. Ceiling Finish
code_block_118 = CodeBlock { ".."; }
code_block_119 = CodeBlock(input=byKeysValues) { input; }
code_block_120 = CodeBlock(i=code_block_119) { i["data_nondic"]; }
code_block_121 = CodeBlock(i=code_block_119) { i["header"]; }
code_block_122 = CodeBlock { "Int."; }
contains_9 = String.Contains(str=code_block_121, searchFor=code_block_122)
code_block_123 = CodeBlock { true; }
allIndicesOf_10 = List.AllIndicesOf(list=contains_9, item=code_block_123)
getItemAtIndex_19 = List.GetItemAtIndex(list=code_block_120, index=allIndicesOf_10)
getItemAtIndex_20 = List.GetItemAtIndex(list=code_block_121, index=allIndicesOf_10)
code_block_124 = CodeBlock { "Ceiling"; }
contains_10 = String.Contains(str=getItemAtIndex_20, searchFor=code_block_124)
code_block_125 = CodeBlock { true; }
allIndicesOf_11 = List.AllIndicesOf(list=contains_10, item=code_block_125)
getItemAtIndex_21 = List.GetItemAtIndex(list=getItemAtIndex_19, index=allIndicesOf_11)
transpose_9 = List.Transpose(lists=getItemAtIndex_21)
join_5 = String.Join(separator=code_block_118, string0=transpose_9@L2)
code_block_126 = CodeBlock { "N/A"; }
isNull_5 = Object.IsNull()  # unwired: object
replaceByCondition_5 = Replace(item=getItemAtIndex_21, replaceWith=code_block_126, condition=isNull_5)

# group: string 검사
code_block_127 = CodeBlock(input=join_5) { input; }
code_block_128 = CodeBlock { ".."; }
endsWith_4 = String.EndsWith(str=code_block_127, searchFor=code_block_128)
code_block_129 = CodeBlock { -1; }
code_block_130 = CodeBlock { -2; }
remove_4 = String.Remove(string=code_block_127, startIndex=code_block_129, count=code_block_130)
if_4 = If(test=endsWith_4, true=remove_4, false=code_block_127)

code_block_131 = CodeBlock(i=code_block_80) { i["countByFloor"]; }

# group: 속성별 데이터 분류-by Grouped as Floor @ Int. Finish
code_block_132 = CodeBlock { ",,"; }
list_create = List.Create(item0=if_, item1=if_2, item2=if_3, item3=if_4)
transpose_10 = List.Transpose(lists=list_create)
join_6 = String.Join(separator=code_block_132, string0=transpose_10)
flatten_5 = List.Flatten(list=join_6)
chop_7 = List.Chop(list=flatten_5, lengths=code_block_131)

# group: 속성별 데이터 분류-by Grouped as Floor @ Roof. Finish
code_block_133 = CodeBlock { ".."; }
code_block_134 = CodeBlock(input=byKeysValues) { input; }
code_block_135 = CodeBlock(i=code_block_134) { i["data_nondic"]; }
code_block_136 = CodeBlock(i=code_block_134) { i["header"]; }
code_block_137 = CodeBlock { "Roof."; }
contains_11 = String.Contains(str=code_block_136, searchFor=code_block_137)
code_block_138 = CodeBlock { true; }
allIndicesOf_12 = List.AllIndicesOf(list=contains_11, item=code_block_138)
getItemAtIndex_22 = List.GetItemAtIndex(list=code_block_135, index=allIndicesOf_12)
transpose_11 = List.Transpose(lists=getItemAtIndex_22)
join_7 = String.Join(separator=code_block_133, string0=transpose_11@L2)
code_block_139 = CodeBlock { "N/A"; }
isNull_6 = Object.IsNull()  # unwired: object
replaceByCondition_6 = Replace(item=getItemAtIndex_22, replaceWith=code_block_139, condition=isNull_6)

# group: string 검사
code_block_140 = CodeBlock(input=join_7) { input; }
code_block_141 = CodeBlock { ".."; }
endsWith_5 = String.EndsWith(str=code_block_140, searchFor=code_block_141)
code_block_142 = CodeBlock { -1; }
code_block_143 = CodeBlock { -2; }
remove_5 = String.Remove(string=code_block_140, startIndex=code_block_142, count=code_block_143)
if_5 = If(test=endsWith_5, true=remove_5, false=code_block_140)

# group: 속성별 데이터 분류-by Grouped as Floor @ Ext. Finish
code_block_144 = CodeBlock { ".."; }
code_block_145 = CodeBlock(input=byKeysValues) { input; }
code_block_146 = CodeBlock(i=code_block_145) { i["data_nondic"]; }
code_block_147 = CodeBlock(i=code_block_145) { i["header"]; }
code_block_148 = CodeBlock { "Ext."; }
contains_12 = String.Contains(str=code_block_147, searchFor=code_block_148)
code_block_149 = CodeBlock { true; }
allIndicesOf_13 = List.AllIndicesOf(list=contains_12, item=code_block_149)
getItemAtIndex_23 = List.GetItemAtIndex(list=code_block_146, index=allIndicesOf_13)
transpose_12 = List.Transpose(lists=getItemAtIndex_23)
join_8 = String.Join(separator=code_block_144, string0=transpose_12@L2)
code_block_150 = CodeBlock { "N/A"; }
isNull_7 = Object.IsNull()  # unwired: object
replaceByCondition_7 = Replace(item=getItemAtIndex_23, replaceWith=code_block_150, condition=isNull_7)

# group: string 검사
code_block_151 = CodeBlock(input=join_8) { input; }
code_block_152 = CodeBlock { ".."; }
endsWith_6 = String.EndsWith(str=code_block_151, searchFor=code_block_152)
code_block_153 = CodeBlock { -1; }
code_block_154 = CodeBlock { -2; }
remove_6 = String.Remove(string=code_block_151, startIndex=code_block_153, count=code_block_154)
if_6 = If(test=endsWith_6, true=remove_6, false=code_block_151)

code_block_155 = CodeBlock(i=code_block_134) { i["countByFloor"]; }

# group: 속성별 데이터 분류-by Grouped as Floor @ Ext. Finish
code_block_156 = CodeBlock { ",,"; }
list_create_2 = List.Create(item0=if_5, item1=if_6)
transpose_13 = List.Transpose(lists=list_create_2)
join_9 = String.Join(separator=code_block_156, string0=transpose_13)
flatten_6 = List.Flatten(list=join_9)
chop_8 = List.Chop(list=flatten_6, lengths=code_block_155)

# group: 속성별 데이터 분류-by Grouped as Floor
code_block_157 = CodeBlock(input=byKeysValues) { input; }
code_block_158 = CodeBlock(i=code_block_157) { i["data"]; }
code_block_159 = CodeBlock(i=code_block_157) { i["header"]; }
integer_slider_11 = IntegerSlider(64, range=0..70 step 1)
code_block_160 = CodeBlock(i=code_block_159, j=integer_slider_11) { i[j]; }
watch_10 = Watch(code_block_160)
valueAtKey_10 = DesignScript.Builtin.Dictionary.ValueAtKey(dictionary=code_block_158, key=watch_10)
code_block_161 = CodeBlock(i=code_block_157) { i["countByFloor"]; }
chop_9 = List.Chop(list=valueAtKey_10, lengths=code_block_161)
string_from_object_6 = FromObject(object=chop_9)
dicipline_2 = CodeBlock(result=string_from_object_6) { result; }

# group: 속성별 데이터 분류-by Grouped as Floor
code_block_162 = CodeBlock(input=byKeysValues) { input; }
code_block_163 = CodeBlock(i=code_block_162) { i["data"]; }
code_block_164 = CodeBlock(i=code_block_162) { i["header"]; }
integer_slider_12 = IntegerSlider(8, range=0..70 step 1)
code_block_165 = CodeBlock(i=code_block_164, j=integer_slider_12) { i[j]; }
watch_11 = Watch(code_block_165)
valueAtKey_11 = DesignScript.Builtin.Dictionary.ValueAtKey(dictionary=code_block_163, key=watch_11)
code_block_166 = CodeBlock(i=code_block_162) { i["countByFloor"]; }
chop_10 = List.Chop(list=valueAtKey_11, lengths=code_block_166)
room_name = CodeBlock(result=chop_10) { result; }

# group: PARAMETERS & COLOR: Setting the parameter values in the space planning families. Changing color of each family instance by associated Department.
code_block_167 = CodeBlock { "Width"; }
setParameterByName = Element.SetParameterByName(element=byPointAndLevel, parameterName=code_block_167, value=length)
code_block_168 = CodeBlock { "Length"; }
setParameterByName_2 = Element.SetParameterByName(element=byPointAndLevel, parameterName=code_block_168, value=length_2)
code_block_169 = CodeBlock { "Program Area"; }
setParameterByName_3 = Element.SetParameterByName(element=byPointAndLevel, parameterName=code_block_169, value=area)
code_block_170 = CodeBlock { "Height"; }
setParameterByName_4 = Element.SetParameterByName(element=byPointAndLevel, parameterName=code_block_170, value=height)
flatten_7 = List.Flatten(list=byPointAndLevel)
code_block_171 = CodeBlock { "Fill Color"; }
# note: This list assigns a name to the RGB
# color values in the Code Block below.
# These color names also correspond to
# the colors from the COLOR column in
# the Excel spreadsheet.
flatten_8 = List.Flatten(list=dicipline)
byName = Material.ByName(name=flatten_8)
# note: this node colorizes each box
# according to the Deparment
# list by replacing the material
# ("Fill Color")
setParameterByName_5 = Element.SetParameterByName(element=flatten_7, parameterName=code_block_171, value=byName)
code_block_172 = CodeBlock { "Interior Finish"; }
setParameterByName_6 = Element.SetParameterByName(element=byPointAndLevel, parameterName=code_block_172, value=chop_7)
code_block_173 = CodeBlock { "Exterior Finish"; }
setParameterByName_7 = Element.SetParameterByName(element=byPointAndLevel, parameterName=code_block_173, value=chop_8)
code_block_174 = CodeBlock { "Department"; }
# note: this series of nodes assigns
# the selected sublists to certain
# parameters in the space planning
# family
setParameterByName_8 = Element.SetParameterByName(element=byPointAndLevel, parameterName=code_block_174, value=dicipline_2)
code_block_175 = CodeBlock { "Room Name"; }
setParameterByName_9 = Element.SetParameterByName(element=byPointAndLevel, parameterName=code_block_175, value=room_name)
code_block_176 = CodeBlock { "Elevation from Level"; 0; }
setParameterByName_10 = Element.SetParameterByName(element=byPointAndLevel, parameterName=code_block_176.out0, value=code_block_176.out1)

elevation = Level.Elevation(level=ofRepeatedItem_6)
