# Dynamo graph 3_Modelization(1222)__.dyn "3_Modelization(1222)" (Dynamo 2.10.1.3976)

categories = Categories("OST_Rooms")
all_elements_of_category = ElementsOfCategory(Category=categories)

# group: 룸 바운더리 추출
coreBoundary = Room.CoreBoundary(room=all_elements_of_category)
code_block = CodeBlock { 1; }
flatten = List.Flatten(list=coreBoundary, amt=code_block)

watch = Watch(flatten)

# group: 룸 중점 외곽선 라인 생성
startPoint = Curve.StartPoint(curve=flatten)
boolean = BoolSelector(true)
byPoints = PolyCurve.ByPoints(points=startPoint, connectLastToFirst=boolean)
byPatch = Surface.ByPatch(closedCurve=byPoints)
code_block_2 = CodeBlock { 0.5; }
pointAtParameter = Surface.PointAtParameter(surface=byPatch, u=code_block_2, v=code_block_2)
graham_scan = Python(IN[0]=pointAtParameter)  # IronPython2
# ---------- graham_scan.python (55 lines) ----------
import clr
clr.AddReference('ProtoGeometry')
from Autodesk.DesignScript.Geometry import *

def ToVals(pt):
	return [pt.X,pt.Y,pt.Z]

def ToPts(ptVals):
	return Point.ByCoordinates(ptVals[0],ptVals[1],ptVals[2])

def CreateOutline(pts):
	crvs = []
	i = 0
	while i < len(pts):
		if i == len(pts)-1:
			crvs.append(Line.ByStartPointEndPoint(pts[i],pts[0]))
		else:
			crvs.append(Line.ByStartPointEndPoint(pts[i],pts[i+1]))
		i = i+1
	return PolyCurve.ByJoinedCurves(crvs)

'''
Taken from Thomas Switzers awesome GitHub repo and modified to suit Dynamo Context
https://gist.github.com/arthur-e/5cf52962341310f438e96c1f3c3398b8
I take zero credit for this work other than porting it across.
'''
def convex_hull_graham(points):
	'''
	Returns points on convex hull in CCW order according to Graham's scan algorithm. 
	By Tom Switzer <thomas.switzer@gmail.com>.
	'''
	TURN_LEFT, TURN_RIGHT, TURN_NONE = (1, -1, 0)

	def cmp(a, b):
		return (a > b) - (a < b)
	
	def turn(p, q, r):
		return cmp((q[0] - p[0])*(r[1] - p[1]) - (r[0] - p[0])*(q[1] - p[1]), 0)
	
	def _keep_left(hull, r):
		while len(hull) > 1 and turn(hull[-2], hull[-1], r) != TURN_LEFT:
			hull.pop()
		if not len(hull) or hull[-1] != r:
			hull.append(r)
		return hull

	points = [ToVals(p) for p in points]	
	points = sorted(points)
	l = reduce(_keep_left, points, [])
	u = reduce(_keep_left, reversed(points), [])
	points = l.extend(u[i] for i in range(1, len(u) - 1)) or l
	points = [ToPts(p) for p in points]
	return CreateOutline(points)

OUT = convex_hull_graham(IN[0])
# ----------------------------------------

# group: 테두리 외곽선 오프셋
byUnion = Surface.ByUnion(surfaces=byPatch)
perimeterCurves = Surface.PerimeterCurves(surface=byUnion)
byJoinedCurves = PolyCurve.ByJoinedCurves(curves=perimeterCurves)
code_block_3 = CodeBlock { -500; }
offset = Curve.Offset(curve=byJoinedCurves, distance=code_block_3)

# group: 내, 외벽 라인 판별 구간
flatten_2 = List.Flatten(list=watch)
patch = Curve.Patch(curve=offset)
doesIntersect = Geometry.DoesIntersect(geometry=flatten_2, other=patch)
filterByBoolMask = List.FilterByBoolMask(list=flatten_2, mask=doesIntersect)

watch_2 = Watch(filterByBoolMask.in)

# group: 내벽 커브 중복제거
code_block_4 = CodeBlock { 0.5; }
pointAtParameter_2 = Curve.PointAtParameter(curve=watch_2, param=code_block_4)
string_from_object = FromObject(object=pointAtParameter_2)
uniqueItems = List.UniqueItems(list=string_from_object)
allIndicesOf = List.AllIndicesOf(list=string_from_object, item=uniqueItems)
firstItem = List.FirstItem(list=allIndicesOf@L2)
getItemAtIndex = List.GetItemAtIndex(list=watch_2, index=firstItem)

# group: 현재 작업중 레벨 정보 추출 구간
code_block_5 = CodeBlock { "Level"; }
getParameterValueByName = Element.GetParameterValueByName(element=all_elements_of_category, parameterName=code_block_5)
uniqueItems_2 = List.UniqueItems(list=getParameterValueByName)
firstItem_2 = List.FirstItem(list=uniqueItems_2)

# group: 현재 작업중 레벨 선택 구간
categories_2 = Categories("OST_Levels")
all_elements_of_category_2 = ElementsOfCategory(Category=categories_2)
name = Element.Name(element=all_elements_of_category_2)
contains = String.Contains(str=name, searchFor=firstItem_2)
filterByBoolMask_2 = List.FilterByBoolMask(list=all_elements_of_category_2, mask=contains)
firstItem_3 = List.FirstItem(list=filterByBoolMask_2.in)

wall_types_int = WallTypes("WA121-Interior RC Wall 200mm")  # graph input

# group: 내벽 생성 구간
watch_3 = Watch(getItemAtIndex)
code_block_6 = CodeBlock { 3000; }
byCurveAndHeight = Wall.ByCurveAndHeight(curve=watch_3, height=code_block_6, level=firstItem_3, wallType=wall_types_int)  # frozen

wall_types_ext = WallTypes("WA111-Exterior RC Wall 200mm")  # graph input

# group: 외벽 생성 구간
watch_4 = Watch(filterByBoolMask.out)
code_block_7 = CodeBlock { 3000; }
byCurveAndHeight_2 = Wall.ByCurveAndHeight(curve=watch_4, height=code_block_7, level=firstItem_3, wallType=wall_types_ext)  # frozen

categories_3 = Categories("OST_Grids")
all_elements_of_category_3 = ElementsOfCategory(Category=categories_3)
curve = Grid.Curve(grid=all_elements_of_category_3)
direction = Line.Direction(line=curve)
normalized = Vector.Normalized(vector=direction)
watch_5 = Watch(normalized)
X = Vector.X(vector=watch_5)
round = Math.Round(number=X)
watch_6 = Watch(round)
code_block_8 = CodeBlock { 0; }
eq = watch_6 == code_block_8
filterByBoolMask_3 = List.FilterByBoolMask(list=curve, mask=eq)
watch_7 = Watch(filterByBoolMask_3.in)
watch_8 = Watch(filterByBoolMask_3.out)
intersect = Geometry.Intersect(geometry=watch_7, other=watch_8, lacing=CrossProduct)
watch_9 = Watch(intersect)
flatten_3 = List.Flatten(list=watch_9)
watch_10 = Watch(flatten_3)
flatten_4 = List.Flatten(list=watch_10)
code_block_9 = CodeBlock { 20000; }
translate = Geometry.Translate(geometry=watch_10, zTranslation=code_block_9)
flatten_5 = List.Flatten(list=translate)
byStartPointEndPoint = Line.ByStartPointEndPoint(startPoint=flatten_4, endPoint=flatten_5)

# group: 기둥 생성 구간
watch_11 = Watch(byStartPointEndPoint)
levels = Levels("2nd")
structural_column_types = StructuralColumnTypes("CL111_500x500")
columnByCurve = StructuralFraming.ColumnByCurve(curve=watch_11, level=levels, structuralColumnType=structural_column_types)  # frozen

Y = Vector.Y(vector=watch_5)
round_2 = Math.Round(number=Y)
watch_12 = Watch(round_2)

# group: Column
code_block_10 = CodeBlock {  }
code_block_11 = CodeBlock {  }

# group: Wall
code_block_12 = CodeBlock {  }
code_block_13 = CodeBlock {  }

# group: Foundation
code_block_14 = CodeBlock {  }
code_block_15 = CodeBlock {  }

# group: 기초
family_types = FamilyTypes("FT112-Footing-Rectangular:FT112_2400x2400x500")
watch_13 = Watch(watch_10)
X_2 = Point.X(point=watch_13)
Y_2 = Point.Y(point=watch_13)
Z = Point.Z(point=watch_13)
byCoordinates = FamilyInstance.ByCoordinates(familyType=family_types, x=X_2, y=Y_2, z=Z)  # frozen

# group: 룸 중점 연결외곽라인의 바운딩 박스 추출 및 해당 바운딩박스 형상의 사각형 생성
boundingBox = Geometry.BoundingBox(geometry=graham_scan)  # frozen
minPoint = BoundingBox.MinPoint(boundingBox=boundingBox)
maxPoint = BoundingBox.MaxPoint(boundingBox=boundingBox)
byTwoPoints = Vector.ByTwoPoints(start=minPoint, end=maxPoint)
X_3 = Vector.X(vector=byTwoPoints)
translate_2 = Geometry.Translate(geometry=minPoint, xTranslation=X_3)
Y_3 = Vector.Y(vector=byTwoPoints)
translate_3 = Geometry.Translate(geometry=minPoint, yTranslation=Y_3)
join = List.Join(list0=translate_2, list1=minPoint, list2=translate_3, list3=maxPoint)

byCornerPoints = Rectangle.ByCornerPoints(points=join)

# group: Framing(Beam & Girder)
code_block_16 = CodeBlock {  }
code_block_17 = CodeBlock {  }

watch_14 = Watch(byPoints)
floor_types = FloorTypes("CFS11_Slab RC_T150")
levels_2 = Levels("2nd")
byOutlineTypeAndLevel = Floor.ByOutlineTypeAndLevel(outline=watch_14, floorType=floor_types, level=levels_2)  # frozen

# group: Floors
code_block_18 = CodeBlock {  }
code_block_19 = CodeBlock {  }

watch_15 = Watch(curve)

# group: 그리드 교차점
watch_16 = Watch(flatten_3)

code_block_20 = CodeBlock(t1=watch_15, t2=watch_16) { curve1 = Curve.SplitByPoints(t1, t2); }
flatten_6 = List.Flatten(list=code_block_20)
string_from_object_2 = FromObject(object=flatten_6)
uniqueItems_3 = List.UniqueItems(list=string_from_object_2@L2)
allIndicesOf_2 = List.AllIndicesOf(list=string_from_object_2, item=uniqueItems_3)
firstItem_4 = List.FirstItem(list=allIndicesOf_2@L2)
getItemAtIndex_2 = List.GetItemAtIndex(list=flatten_6, index=firstItem_4)
watch_levels = Watch(levels_2)
elevation = Level.Elevation(level=watch_levels)
translate_4 = Geometry.Translate(geometry=getItemAtIndex_2, zTranslation=elevation)

# group: 외곽선 500 오프셋
code_block_21 = CodeBlock { 500; }
offset_2 = Curve.Offset(curve=byJoinedCurves, distance=code_block_21)

doesIntersect_2 = Geometry.DoesIntersect(geometry=translate_4, other=offset_2)
filterByBoolMask_4 = List.FilterByBoolMask(list=translate_4, mask=doesIntersect_2)
watch_17 = Watch(filterByBoolMask_4.out)
flatten_7 = List.Flatten(list=watch_17)

# group: 유효 그리드 세그먼트 판별
length = Curve.Length(curve=flatten_7)
code_block_22 = CodeBlock { 0; }
round_3 = Math.Round(number=length, digits=code_block_22)
code_block_23 = CodeBlock(i=round_3) { i == true? true:false; }
filterByBoolMask_5 = List.FilterByBoolMask(list=flatten_7, mask=code_block_23)

levels_3 = Levels("2nd")
family_types_2 = FamilyTypes("Concrete-Rectangular-Beam:BM111_400x500_RG1")
beamByCurve = StructuralFraming.BeamByCurve(curve=filterByBoolMask_5.in, level=levels_3, structuralFramingType=family_types_2)  # frozen
isNull = Object.IsNull(object=beamByCurve)
countFalse = List.CountFalse(list=isNull)

# group: All Room Elements
categories_4 = Categories("OST_Rooms")
all_elements_of_category_4 = ElementsOfCategory(Category=categories_4)

# group: Create RoomInfo Instances
string_from_web = Python()  # CPython3; unwired: IN[0]
# ---------- string_from_web.python (19 lines) ----------
# Load the Python Standard and DesignScript Libraries
import sys
import clr
clr.AddReference('ProtoGeometry')
from Autodesk.DesignScript.Geometry import *
import urllib.request

# The inputs to this node will be stored as a list in the IN variables.
dataEnteringNode = IN
inputURL = "https://raw.githubusercontent.com/HNANmal/mQ/master/Hdynlib/DataStructure/Custom/Rooms/CreateRoomInfoInstance.py"

# Place your code below this line
req = urllib.request
data = req.urlopen(inputURL)

result = data.read().decode("utf-8")

# Assign your output to the OUT variable.
OUT = result
# ----------------------------------------
string_from_web_2 = Python()  # CPython3; unwired: IN[0]
# ---------- string_from_web_2.python (19 lines) ----------
# Load the Python Standard and DesignScript Libraries
import sys
import clr
clr.AddReference('ProtoGeometry')
from Autodesk.DesignScript.Geometry import *
import urllib.request

# The inputs to this node will be stored as a list in the IN variables.
dataEnteringNode = IN
inputURL = "https://raw.githubusercontent.com/HNANmal/mQ/master/Hdynlib/DataStructure/Custom/Rooms/RoomInfoClass.py"

# Place your code below this line
req = urllib.request
data = req.urlopen(inputURL)

result = data.read().decode("utf-8")

# Assign your output to the OUT variable.
OUT = result
# ----------------------------------------
roominfoclass = PythonStringNode(script=string_from_web_2, IN[1]=all_elements_of_category_4)  # CPython3; unwired: IN[0]
createroominfoinstance = PythonStringNode(script=string_from_web, IN[1]=all_elements_of_category_4, IN[2]=roominfoclass)  # CPython3; unwired: IN[0]
code_block_24 = CodeBlock(i=createroominfoinstance) { i[0]; i[1]; }
roomInfoInstances = CodeBlock(result=code_block_24.out1) { result; }

code_block_25 = CodeBlock()  # //RevitMemberCreaterClass
watch_18 = Watch(code_block_24.out0)

# group: All Levels Elements
categories_5 = Categories("OST_Levels")
all_elements_of_category_5 = ElementsOfCategory(Category=categories_5)

# group: All Grids Elements
categories_6 = Categories("OST_Grids")
all_elements_of_category_6 = ElementsOfCategory(Category=categories_6)

python_script = Python(IN[0]=all_elements_of_category_5, IN[1]=all_elements_of_category_6)  # "Python Script@createGridIntersectPointsDict"; CPython3; unwired: IN[2]
# ---------- python_script.python (69 lines) ----------
# Load the Python Standard and DesignScript Libraries
import sys
import clr
clr.AddReference('ProtoGeometry')
from Autodesk.DesignScript.Geometry import *

clr.AddReference('RevitAPI')
from Autodesk.Revit.DB import *

clr.AddReference("RevitServices")
import RevitServices
from RevitServices.Persistence import DocumentManager
from RevitServices.Transactions import TransactionManager

clr.AddReference("RevitNodes")
import Revit

doc = DocumentManager.Instance.CurrentDBDocument

#crv = Revit.GeometryConversion.RevitToProtoCurve.ToProtoType( crv, true )

# The inputs to this node will be stored as a list in the IN variables.
dataEnteringNode = IN

#alllevels =  FilteredElementCollector(doc).OfClass(Level).WhereElementIsNotElementType().ToElements()

#allgrids = FilteredElementCollector(doc).OfClass(Grid).WhereElementIsNotElementType().ToElements()
alllevels = IN[0]
allgrids = IN[1]

class GridInfo():
    def __init__(self, grid):
        def findDirection(gridVector):
            if gridVector.IsParallel(Vector.XAxis()):
                return "X_axis"
            else:
                return "Y_axis"
        gridName = grid.Name
        self.gridName = gridName
        gridCrv = grid.Curve
        self.gridCrv = gridCrv
        gridVector = gridCrv.Direction.Normalized()
        self.gridVector = gridVector
        direction = findDirection(gridVector)
        self.direction = direction

# Place your code below this line

def createCrossPointsDict(allgrids):
    all_gridInfo = list(map(lambda i: GridInfo(i), allgrids))
    xgridInfo = list(filter(lambda i: i.direction == "X_axis", all_gridInfo))
    ygridInfo = list(filter(lambda i: i.direction == "Y_axis", all_gridInfo))
    def getPtsDict(xgridInfo, ygridInfo):
        _keys = []
        _result = {}
        for i in xgridInfo:
            for j in ygridInfo:
                loc_mark = '-'.join([i.gridName, j.gridName])
                loc_pts = i.gridCrv.Intersect(j.gridCrv)
                _result[loc_mark] = loc_pts
                _keys.append(loc_mark)
        return [_keys, _result]

    result = getPtsDict(xgridInfo, ygridInfo)
    return result

result = createCrossPointsDict(allgrids)
# Assign your output to the OUT variable.
OUT = result
# ----------------------------------------
code_block_26 = CodeBlock(i=python_script) { i[0]; i[1]; }
valueAtKey = DesignScript.Builtin.Dictionary.ValueAtKey(dictionary=code_block_26.out1, key=code_block_26.out0)

# group: 기초 배치구간
family_types_3 = FamilyTypes("FT112-Footing-Rectangular:FT112_2400x2400x500")
code_block_27 = CodeBlock(input=valueAtKey) { input; }
flatten_8 = List.Flatten(list=code_block_27)
categories_7 = Categories("OST_Levels")
all_elements_of_category_7 = ElementsOfCategory(Category=categories_7)
code_block_28 = CodeBlock(i=all_elements_of_category_7) { i[1]; }
byPointAndLevel = FamilyInstance.ByPointAndLevel(familyType=family_types_3, point=flatten_8, level=code_block_28)
