# Dynamo graph 3_Modelization(1223).dyn (Dynamo 2.10.1.3976)
# packages: GenerativeDesign 1.7.3.0, GenerativeDesign 1.10.10.0

# group: All Levels Elements
categories = Categories("OST_Levels")
all_elements_of_category = ElementsOfCategory(Category=categories)

# group: LevelsExceptB
string_from_web = Python()  # CPython3; unwired: IN[0]
# ---------- string_from_web.python (19 lines) ----------
# Load the Python Standard and DesignScript Libraries
import sys
import clr
clr.AddReference('ProtoGeometry')
from Autodesk.DesignScript.Geometry import *
import urllib.request

# The inputs to this node will be stored as a list in the IN variables.
dataEnteringNode = IN
inputURL = "https://raw.githubusercontent.com/HNANmal/mQ/master/Hdynlib/Revit/Elements/Filtering/FilterElementsExceptTarget.py"

# Place your code below this line
req = urllib.request
data = req.urlopen(inputURL)

result = data.read().decode("utf-8")

# Assign your output to the OUT variable.
OUT = result
# ----------------------------------------
boolean = BoolSelector(false)
code_block = CodeBlock { "B"; }
filterelementsexcepttarget = PythonStringNode(script=string_from_web, IN[0]=all_elements_of_category, IN[1]=boolean, IN[2]=code_block)  # CPython3

# group: All Room Elements
categories_2 = Categories("OST_Rooms")
all_elements_of_category_2 = ElementsOfCategory(Category=categories_2)

# group: Create RoomDS(Data Structure)
string_from_web_2 = Python()  # CPython3; unwired: IN[0]
# ---------- string_from_web_2.python (19 lines) ----------
# Load the Python Standard and DesignScript Libraries
import sys
import clr
clr.AddReference('ProtoGeometry')
from Autodesk.DesignScript.Geometry import *
import urllib.request

# The inputs to this node will be stored as a list in the IN variables.
dataEnteringNode = IN
inputURL = "https://raw.githubusercontent.com/HNANmal/mQ/master/Hdynlib/DataStructure/Custom/Rooms/CreateRoomDS.py"

# Place your code below this line
req = urllib.request
data = req.urlopen(inputURL)

result = data.read().decode("utf-8")

# Assign your output to the OUT variable.
OUT = result
# ----------------------------------------
createroomds = PythonStringNode(script=string_from_web_2, IN[1]=all_elements_of_category_2)  # CPython3; unwired: IN[0]

# group: All Grids Elements
categories_3 = Categories("OST_Grids")
all_elements_of_category_3 = ElementsOfCategory(Category=categories_3)

# group: Create GridDS(Data Structure)
python_script_create_gridds = Python(IN[0]=all_elements_of_category_3)  # CPython3
# ---------- python_script_create_gridds.python (80 lines) ----------
# Load the Python Standard and DesignScript Libraries
import sys
import clr
clr.AddReference('ProtoGeometry')
from Autodesk.DesignScript.Geometry import *

clr.AddReference('RevitAPI')
from Autodesk.Revit.DB import *

clr.AddReference("RevitServices")
import RevitServices
from RevitServices.Persistence import DocumentManager
from RevitServices.Transactions import TransactionManager

clr.AddReference("RevitNodes")
import Revit

doc = DocumentManager.Instance.CurrentDBDocument
from itertools import chain
from collections import defaultdict

# The inputs to this node will be stored as a list in the IN variables.
dataEnteringNode = IN

allgrids = IN[0]

def Create_GridDS(grid, allgrids):
    def findDirection(grid):
        gridVector = grid.Curve.Direction.Normalized()
        if gridVector.IsParallel(Vector.XAxis()):
            return "X_axis"
        else:
            return "Y_axis"
            
    x_Grids = list(filter(lambda i: findDirection(i) == "X_axis", allgrids))
    y_Grids = list(filter(lambda i: findDirection(i) == "Y_axis", allgrids))
    
    intPtsDict = []
    if findDirection(grid) == "X_axis":
        for i in y_Grids:
            tmp = {}
            mark = '-'.join([grid.Name, i.Name])
            tmp[f'{mark}'] = grid.Curve.Intersect(i.Curve)
            intPtsDict.append(tmp)
        
    else:
        for i in x_Grids:
            tmp = {}
            mark = '-'.join([i.Name, grid.Name])
            tmp[f'{mark}'] = grid.Curve.Intersect(i.Curve)
            intPtsDict.append(tmp)
        
    _intPts = list(map(lambda i: i.values(), intPtsDict))
    intPts = list(chain(*chain(*_intPts)))
    gridName = grid.Name
    gridCrv = grid.Curve
    gridVector = gridCrv.Direction.Normalized()
    direction = findDirection(grid)
    segments = gridCrv.SplitByPoints(intPts)
    
    result = {
        "element": grid,
        "gridName": gridName,
        "gridCrv": gridCrv,
        "gridVector": gridVector,
        "direction": direction,
        "intPtsDict": intPtsDict,
        "intPts": intPts,
        "segments": segments
        }
    return result
    

# Place your code below this line

all_GridDS = list(map(lambda i: Create_GridDS(i, allgrids), allgrids))

result = all_GridDS
# Assign your output to the OUT variable.
OUT = result
# ----------------------------------------

dataHub = CodeBlock(AllLevels=all_elements_of_category, LevelsExceptB=filterelementsexcepttarget, RoomDS=createroomds, GridDS=python_script_create_gridds)
# ---------- dataHub.designscript (10 lines) ----------
DataHub = {
	"AllLevels": AllLevels,
	"LevelsExceptB": LevelsExceptB,
	"RoomDS": RoomDS,
	"GridDS": GridDS
};
DataHub["AllLevels"];
DataHub["LevelsExceptB"];
DataHub["RoomDS"];
DataHub["GridDS"];
# ----------------------------------------

# group: 추가 데이터 조작 및 정렬
gridDS = CodeBlock(DataHub=dataHub.DataHub)
# ---------- gridDS.designscript (30 lines) ----------
DataHub;
DataHub["AllLevels"];
DataHub["LevelsExceptB"];
DataHub["RoomDS"];
DataHub["RoomDS"]["name"];
DataHub["RoomDS"]["level"];
DataHub["RoomDS"]["department"];
DataHub["RoomDS"]["roomelem"];
DataHub["RoomDS"]["roomsolid"];
DataHub["RoomDS"]["basefinish"];
DataHub["RoomDS"]["ceilfinish"];
DataHub["RoomDS"]["wallfinish"];
DataHub["RoomDS"]["floorfinish"];
DataHub["RoomDS"]["rooffinish"];
DataHub["RoomDS"]["extwallfinish"];
DataHub["RoomDS"]["roomsideface"];
DataHub["RoomDS"]["roomupperface"];
DataHub["RoomDS"]["roombottomface"];
DataHub["RoomDS"]["roomperimeter"];
DataHub["RoomDS"]["adjrooms"];
DataHub["RoomDS"]["surfacedict"];
DataHub["GridDS"];
DataHub["GridDS"]["element"];
DataHub["GridDS"]["gridName"];
DataHub["GridDS"]["gridCrv"];
DataHub["GridDS"]["gridVector"];
DataHub["GridDS"]["direction"];
DataHub["GridDS"]["intPtsDict"];
DataHub["GridDS"]["intPts"];
DataHub["GridDS"]["segments"];
# ----------------------------------------
code_block_2 = CodeBlock(i=gridDS.out21) { i["direction"]=="X_axis"; }
filterByBoolMask = List.FilterByBoolMask(list=gridDS.out21, mask=code_block_2)
code_block_3 = CodeBlock(pGridDS=filterByBoolMask.in) { pGridDS["intPts"]; }
string_from_web_3 = Python()  # CPython3; unwired: IN[0]; same code as string_from_web
boolean_2 = BoolSelector(true)
code_block_4 = CodeBlock { "B"; }
filterelementsexcepttarget_2 = PythonStringNode(script=string_from_web_3, IN[0]=gridDS.out1, IN[1]=boolean_2, IN[2]=code_block_4)  # CPython3

# group: 기초 배치구간
structural_foundation_family = FamilyTypes("FT112-Footing-Rectangular:FT112_2400x2400x500")  # "Structural Foundation Family Types 선택"; graph input
code_block_5 = CodeBlock(intPts=code_block_3, level_B=filterelementsexcepttarget_2) { intPts; level_B; }
flatten = List.Flatten(list=code_block_5.intPts)
byPointAndLevel = FamilyInstance.ByPointAndLevel(familyType=structural_foundation_family, point=flatten, level=code_block_5.level_B, lacing=CrossProduct)  # frozen

remember = Data.Remember()  # unwired: arg0
flatten_2 = List.Flatten(list=remember)
code_block_6 = CodeBlock { 0.5; }
pointAtParameter = Surface.PointAtParameter(surface=flatten_2, u=code_block_6, v=code_block_6)
Z = Point.Z(point=pointAtParameter)
round = Math.Round(number=Z)
uniqueItems = List.UniqueItems(list=round)
eq = uniqueItems == Z  # lacing=CrossProduct
filterByBoolMask_2 = List.FilterByBoolMask(list=flatten_2, mask=eq@L2)
watch = Watch(filterByBoolMask_2.in)
perimeterCurves = Surface.PerimeterCurves(surface=watch)
byJoinedCurves = PolyCurve.ByJoinedCurves(curves=perimeterCurves)
string_from_web_4 = Python()  # CPython3; unwired: IN[0]; same code as string_from_web
boolean_3 = BoolSelector(false)
code_block_7 = CodeBlock { "B"; }
filterelementsexcepttarget_3 = PythonStringNode(script=string_from_web_4, IN[1]=boolean_3, IN[2]=code_block_7)  # CPython3; unwired: IN[0]

# group: Floor 배치 구간
floor_types = FloorTypes("CFS11_Slab RC_T150")
byOutlineTypeAndLevel = Floor.ByOutlineTypeAndLevel(outline=byJoinedCurves, floorType=floor_types, level=filterelementsexcepttarget_3)  # frozen

code_block_8 = CodeBlock { i; }  # unwired: i
python_script = Python(IN[0]=code_block_8)  # CPython3
# ---------- python_script.python (16 lines) ----------
# Load the Python Standard and DesignScript Libraries
import sys
import clr
clr.AddReference('ProtoGeometry')
from Autodesk.DesignScript.Geometry import *

# The inputs to this node will be stored as a list in the IN variables.
dataEnteringNode = IN

inputs = IN[0]

# Place your code below this line

result = list(map(lambda i: i["roombottomface"], inputs))
# Assign your output to the OUT variable.
OUT = result
# ----------------------------------------
code_block_9 = CodeBlock { i; }  # unwired: i
python_script_2 = Python(IN[0]=code_block_9)  # CPython3
# ---------- python_script_2.python (43 lines) ----------
# Load the Python Standard and DesignScript Libraries
import sys
import clr
clr.AddReference('ProtoGeometry')
from Autodesk.DesignScript.Geometry import *

# The inputs to this node will be stored as a list in the IN variables.
dataEnteringNode = IN

inputs = IN[0]

# Place your code below this line
def rooffinbln(x):
    if len(x["rooffinish"])==0:
        return False
    else:
        for i in x["rooffinish"]:
            if "RF" in i:
                return True
            else:
                return False

def ceilfinbln(x):
    if len(x["ceilfinish"])==0:
        return False
    else:
        for i in x["ceilfinish"]:
            if "CL" in i:
                return True
            else:
                return False

#result = list(filter(lambda i: "RF" in i.rooffinish, inputs))
#_targets = list(
#            filter(lambda i: rooffinbln(i),
#                filter(lambda j: ceilfinbln(j), inputs))
#                )
_targets = list(filter(lambda i: i["level"] == "4F", inputs))
targets = list(filter(lambda i: rooffinbln(i), _targets))
result1 = list(map(lambda i: i["roombottomface"], targets))
result2 = list(map(lambda i: i["level"], targets))
# Assign your output to the OUT variable.
OUT = [result1, result2]
# ----------------------------------------
remember_2 = Data.Remember(python_script_2)
code_block_10 = CodeBlock(i=remember_2) { List.Flatten(i[0]); }
ZAxis = Vector.ZAxis()
all_levels = CodeBlock { i; }  # unwired: i
elevation = Level.Elevation()  # unwired: level
sortByFunction = List.SortByFunction(list=all_levels, sortFunction=elevation)
string_from_object = FromObject(object=sortByFunction)
code_block_11 = CodeBlock(i=remember_2) { i[1]; }
uniqueItems_2 = List.UniqueItems(list=code_block_11)
firstItem = List.FirstItem(list=uniqueItems_2)
contains = String.Contains(str=string_from_object, searchFor=firstItem)
code_block_12 = CodeBlock { true; }
allIndicesOf = List.AllIndicesOf(list=contains, item=code_block_12)
code_block_13 = CodeBlock(i=allIndicesOf) { i+1; }
getItemAtIndex = List.GetItemAtIndex(list=sortByFunction, index=code_block_13)
elevation_2 = Level.Elevation(level=getItemAtIndex)
getItemAtIndex_2 = List.GetItemAtIndex(list=sortByFunction, index=allIndicesOf)
elevation_3 = Level.Elevation(level=getItemAtIndex_2)
sub = elevation_2 - elevation_3
code_block_14 = CodeBlock(i=sub) { i[0]; }
translate = Geometry.Translate(geometry=code_block_10, direction=ZAxis, distance=code_block_14)
code_block_15 = CodeBlock { i; }  # unwired: i
python_script_3 = Python(IN[0]=code_block_15)  # CPython3
# ---------- python_script_3.python (16 lines) ----------
# Load the Python Standard and DesignScript Libraries
import sys
import clr
clr.AddReference('ProtoGeometry')
from Autodesk.DesignScript.Geometry import *

# The inputs to this node will be stored as a list in the IN variables.
dataEnteringNode = IN

inputs = IN[0]

# Place your code below this line
target =  list(filter(lambda i: i["level"] == "PF", inputs))
result = list(map(lambda i: i["roomupperface"], target))
# Assign your output to the OUT variable.
OUT = result
# ----------------------------------------
remember_3 = Data.Remember(python_script_3)
flatten_3 = List.Flatten(list=remember_3)
join = List.Join(list0=translate, list1=flatten_3)
perimeterCurves_2 = Surface.PerimeterCurves(surface=join)
byJoinedCurves_2 = PolyCurve.ByJoinedCurves(curves=perimeterCurves_2)
levels = Levels("PF")

# group: Roof 배치 구간
floor_types_2 = FloorTypes("CFS11_Slab RC_T150")
byOutlineTypeAndLevel_2 = Floor.ByOutlineTypeAndLevel(outline=byJoinedCurves_2, floorType=floor_types_2, level=levels)  # frozen

code_block_16 = CodeBlock { i; }  # unwired: i
remember_4 = Data.Remember()  # unwired: arg0
flatten_4 = List.Flatten(list=remember_4)
python_script_4 = Python(IN[0]=flatten_4)  # CPython3
# ---------- python_script_4.python (30 lines) ----------
# Load the Python Standard and DesignScript Libraries
import sys
import clr
clr.AddReference('ProtoGeometry')
from Autodesk.DesignScript.Geometry import *

# The inputs to this node will be stored as a list in the IN variables.
dataEnteringNode = IN

inputs = IN[0]
# Place your code below this line
#def findunderline(lines):
#    tmp = list(map(i.StartPoint

target1 = list(map(lambda i: i.PerimeterCurves(), inputs))

result = []
for i in target1:
    tmp1 = list(filter(lambda x: x.Direction.Z == 0, i))
    tmp2 = []
    if tmp1[0].StartPoint.Z < tmp1[1].StartPoint.Z:
        tmp2.append(tmp1[0])
    else:
        tmp2.append(tmp1[1])
    result.append(tmp2)
        

#result = list(filter(lambda i: i.StartPoint == 
# Assign your output to the OUT variable.
OUT = result
# ----------------------------------------
flatten_5 = List.Flatten(list=python_script_4)
byCurveAndHeight = Wall.ByCurveAndHeight(curve=flatten_5)  # unwired: height, level, wallType
perimeterCurves_3 = Surface.PerimeterCurves()  # unwired: surface
direction = Line.Direction()  # unwired: line
startPoint = Curve.StartPoint()  # unwired: curve
string_from_object_2 = FromObject(object=flatten_5)
uniqueItems_3 = List.UniqueItems(list=string_from_object_2)

# group: 페데스탈 배치구간
structural_column_types_선택 = StructuralColumnTypes("CL111_500x500")
code_block_17 = CodeBlock(intPts=code_block_3, level_B=filterelementsexcepttarget_2) { intPts; level_B; }
flatten_6 = List.Flatten(list=code_block_17.intPts)
byPointAndLevel_2 = FamilyInstance.ByPointAndLevel(familyType=structural_column_types_선택, point=flatten_6, level=code_block_17.level_B, lacing=CrossProduct)  # frozen

# group: 기둥 배치구간
structural_column_types_선택_2 = StructuralColumnTypes("CL111_500x500")
code_block_18 = CodeBlock(intPts=code_block_3, LevelsExceptB=gridDS.out2) { intPts; LevelsExceptB; }
flatten_7 = List.Flatten(list=code_block_18.intPts)
byPointAndLevel_3 = FamilyInstance.ByPointAndLevel(familyType=structural_column_types_선택_2, point=flatten_7, level=code_block_18.LevelsExceptB, lacing=CrossProduct)  # frozen

# group: 추가 데이터 조작 및 정렬
gridDS_2 = CodeBlock(DataHub=dataHub.DataHub)  # same code as gridDS
code_block_19 = CodeBlock(i=gridDS_2.out21) { i["direction"]=="X_axis"; }
filterByBoolMask_3 = List.FilterByBoolMask(list=gridDS_2.out21, mask=code_block_19)
code_block_20 = CodeBlock(XGridDS=filterByBoolMask_3.in) { XGridDS["segments"]; }
code_block_21 = CodeBlock { 1; }
dropItems = List.DropItems(list=code_block_20@L2, amount=code_block_21)
code_block_22 = CodeBlock { -1; }
dropItems_2 = List.DropItems(list=dropItems@L2, amount=code_block_22)
code_block_23 = CodeBlock(segmentsX_real=dropItems_2) { segmentsX_real; }
code_block_24 = CodeBlock(YGridDS=filterByBoolMask_3.out) { YGridDS["segments"]; }
code_block_25 = CodeBlock { 1; }
dropItems_3 = List.DropItems(list=code_block_24@L2, amount=code_block_25)
code_block_26 = CodeBlock { -1; }
dropItems_4 = List.DropItems(list=dropItems_3@L2, amount=code_block_26)
code_block_27 = CodeBlock(segmentsY_real=dropItems_4) { segmentsY_real; }
string_from_web_5 = Python()  # CPython3; unwired: IN[0]; same code as string_from_web
boolean_4 = BoolSelector(true)
code_block_28 = CodeBlock { "B"; }
filterelementsexcepttarget_4 = PythonStringNode(script=string_from_web_5, IN[0]=gridDS_2.out1, IN[1]=boolean_4, IN[2]=code_block_28)  # CPython3

# group: 타이거더 배치 구간(Y 축 방향)
code_block_29 = CodeBlock(segmentsX_real=code_block_23, segmentsY_real=code_block_27, level_B=filterelementsexcepttarget_4) { segmentsX_real; segmentsY_real; level_B; }
flatten_8 = List.Flatten(list=code_block_29.segmentsY_real)
지중보_girder_family_types_선택 = FamilyTypes("Concrete-Rectangular-Beam:BM111_400x500_RG1")  # graph input
beamByCurve = StructuralFraming.BeamByCurve(curve=flatten_8, level=code_block_29.level_B, structuralFramingType=지중보_girder_family_types_선택, lacing=CrossProduct)  # frozen

# group: 타이빔 배치 구간(Y 축 방향)
타이빔_y축_방향_생성_여부 = BoolSelector(true)  # graph input
code_block_30 = CodeBlock(segmentsX_real=code_block_23, segmentsY_real=code_block_27, level_B=filterelementsexcepttarget_4) { segmentsX_real; segmentsY_real; level_B; }
transpose = List.Transpose(lists=code_block_30.segmentsX_real)
code_block_31 = CodeBlock { 0.5; }
pointAtParameter_2 = Curve.PointAtParameter(curve=transpose, param=code_block_31)
createCurveForBeam = Python(IN[0]=pointAtParameter_2)  # CPython3
# ---------- createCurveForBeam.python (21 lines) ----------
# Load the Python Standard and DesignScript Libraries
import sys
import clr
clr.AddReference('ProtoGeometry')
from Autodesk.DesignScript.Geometry import *

# The inputs to this node will be stored as a list in the IN variables.
dataEnteringNode = IN
ptsGroup = IN[0]

# Place your code below this line
result = []
for i in ptsGroup:
    for j in range(len(i)):
        if j < len(i)-1:
            result.append(Line.ByStartPointEndPoint(i[j], i[j+1]))
        else:
            pass

# Assign your output to the OUT variable.
OUT = result
# ----------------------------------------
실행여부_결정 = Python(IN[0]=타이빔_y축_방향_생성_여부, IN[1]=createCurveForBeam)  # CPython3
# ---------- 실행여부_결정.python (21 lines) ----------
# Load the Python Standard and DesignScript Libraries
import sys
import clr
clr.AddReference('ProtoGeometry')
from Autodesk.DesignScript.Geometry import *

# The inputs to this node will be stored as a list in the IN variables.
dataEnteringNode = IN

bln = IN[0]
inputs = IN[1]

# Place your code below this line

if bln:
    result = inputs
else:
    result = []

# Assign your output to the OUT variable.
OUT = result
# ----------------------------------------
지중보_beam_family_types_선택 = FamilyTypes("Concrete-Rectangular-Beam:BM111_400x500_RG1")  # graph input
beamByCurve_2 = StructuralFraming.BeamByCurve(curve=실행여부_결정, level=code_block_30.level_B, structuralFramingType=지중보_beam_family_types_선택, lacing=CrossProduct)  # frozen

# group: 타이거더 배치 구간(X 축 방향)
code_block_32 = CodeBlock(segmentsX_real=code_block_23, segmentsY_real=code_block_27, level_B=filterelementsexcepttarget_4) { segmentsX_real; segmentsY_real; level_B; }
flatten_9 = List.Flatten(list=code_block_32.segmentsX_real)
beamByCurve_3 = StructuralFraming.BeamByCurve(curve=flatten_9, level=code_block_32.level_B, structuralFramingType=지중보_girder_family_types_선택, lacing=CrossProduct)  # frozen

# group: 타이빔 배치 구간(X 축 방향)
타이빔_x축_방향_생성_여부 = BoolSelector(false)  # graph input
code_block_33 = CodeBlock(segmentsX_real=code_block_23, segmentsY_real=code_block_27, level_B=filterelementsexcepttarget_4) { segmentsX_real; segmentsY_real; level_B; }
transpose_2 = List.Transpose(lists=code_block_33.segmentsY_real)
code_block_34 = CodeBlock { 0.5; }
pointAtParameter_3 = Curve.PointAtParameter(curve=transpose_2, param=code_block_34)
createCurveForBeam_2 = Python(IN[0]=pointAtParameter_3)  # CPython3; same code as createCurveForBeam
실행여부_결정_2 = Python(IN[0]=타이빔_x축_방향_생성_여부, IN[1]=createCurveForBeam_2)  # CPython3; same code as 실행여부_결정
beamByCurve_4 = StructuralFraming.BeamByCurve(curve=실행여부_결정_2, level=code_block_33.level_B, structuralFramingType=지중보_beam_family_types_선택, lacing=CrossProduct)  # frozen

code_block_35 = CodeBlock(LevelsExceptB=gridDS_2.out2) { LevelsExceptB; }

# group: 거더 배치 구간(Y 축 방향)
girder_family_types_선택 = FamilyTypes("Concrete-Rectangular-Beam:BM111_400x500_RG1")  # graph input
code_block_36 = CodeBlock(segmentsX_real=code_block_23, segmentsY_real=code_block_27, LevelsExceptB=code_block_35) { segmentsX_real; segmentsY_real; LevelsExceptB; }
flatten_10 = List.Flatten(list=code_block_36.segmentsY_real)
elevation_4 = Level.Elevation(level=code_block_36.LevelsExceptB)
translate_2 = Geometry.Translate(geometry=flatten_10, zTranslation=elevation_4, lacing=CrossProduct)
beamByCurve_5 = StructuralFraming.BeamByCurve(curve=translate_2, level=code_block_36.LevelsExceptB, structuralFramingType=girder_family_types_선택, lacing=CrossProduct)  # frozen

# group: 거더 배치 구간(X 축 방향)
code_block_37 = CodeBlock(segmentsX_real=code_block_23, segmentsY_real=code_block_27, LevelsExceptB=code_block_35) { segmentsX_real; segmentsY_real; LevelsExceptB; }
flatten_11 = List.Flatten(list=code_block_37.segmentsX_real)
elevation_5 = Level.Elevation(level=code_block_37.LevelsExceptB)
translate_3 = Geometry.Translate(geometry=flatten_11, zTranslation=elevation_5, lacing=CrossProduct)
beamByCurve_6 = StructuralFraming.BeamByCurve(curve=translate_3, level=code_block_37.LevelsExceptB, structuralFramingType=girder_family_types_선택, lacing=CrossProduct)  # frozen

code_block_38 = CodeBlock(LevelsExceptB=gridDS_2.out2) { LevelsExceptB; }

# group: 빔 배치 구간(Y 축 방향)
beam_family_types_선택 = FamilyTypes("Concrete-Rectangular-Beam:BM111_400x500_RG1")  # graph input
타이빔_y축_방향_생성_여부_2 = BoolSelector(true)  # graph input
code_block_39 = CodeBlock(segmentsX_real=code_block_23, segmentsY_real=code_block_27, LevelsExceptB=code_block_38) { segmentsX_real; segmentsY_real; LevelsExceptB; }
transpose_3 = List.Transpose(lists=code_block_39.segmentsX_real)
code_block_40 = CodeBlock { 0.5; }
pointAtParameter_4 = Curve.PointAtParameter(curve=transpose_3, param=code_block_40)
createCurveForBeam_3 = Python(IN[0]=pointAtParameter_4)  # CPython3; same code as createCurveForBeam
elevation_6 = Level.Elevation(level=code_block_39.LevelsExceptB)
translate_4 = Geometry.Translate(geometry=createCurveForBeam_3, zTranslation=elevation_6, lacing=CrossProduct)
실행여부_결정_3 = Python(IN[0]=타이빔_y축_방향_생성_여부_2, IN[1]=translate_4)  # CPython3; same code as 실행여부_결정
beamByCurve_7 = StructuralFraming.BeamByCurve(curve=실행여부_결정_3, level=code_block_39.LevelsExceptB, structuralFramingType=beam_family_types_선택, lacing=CrossProduct)  # frozen

# group: 빔 배치 구간(X 축 방향)
타이빔_x축_방향_생성_여부_2 = BoolSelector(false)  # graph input
code_block_41 = CodeBlock(segmentsX_real=code_block_23, segmentsY_real=code_block_27, LevelsExceptB=code_block_38) { segmentsX_real; segmentsY_real; LevelsExceptB; }
transpose_4 = List.Transpose(lists=code_block_41.segmentsY_real)
code_block_42 = CodeBlock { 0.5; }
pointAtParameter_5 = Curve.PointAtParameter(curve=transpose_4, param=code_block_42)
createCurveForBeam_4 = Python(IN[0]=pointAtParameter_5)  # CPython3; same code as createCurveForBeam
elevation_7 = Level.Elevation(level=code_block_41.LevelsExceptB)
translate_5 = Geometry.Translate(geometry=createCurveForBeam_4, zTranslation=elevation_7, lacing=CrossProduct)
실행여부_결정_4 = Python(IN[0]=타이빔_x축_방향_생성_여부_2, IN[1]=translate_5)  # CPython3; same code as 실행여부_결정
beamByCurve_8 = StructuralFraming.BeamByCurve(curve=실행여부_결정_4, level=code_block_41.LevelsExceptB, structuralFramingType=beam_family_types_선택, lacing=CrossProduct)  # frozen

# group: 최상층 빔 배치 구간(Y 축 방향)
beam_family_types_선택_2 = FamilyTypes("Concrete-Rectangular-Beam:BM111_400x500_RG1")  # graph input
타이빔_y축_방향_생성_여부_3 = BoolSelector(true)  # graph input
code_block_43 = CodeBlock(segmentsX_real=code_block_23, segmentsY_real=code_block_27) { segmentsX_real; segmentsY_real; LevelTop; }  # unwired: LevelTop
transpose_5 = List.Transpose(lists=code_block_43.segmentsX_real)
code_block_44 = CodeBlock { 0.5; }
pointAtParameter_6 = Curve.PointAtParameter(curve=transpose_5, param=code_block_44)
createCurveForBeam_5 = Python(IN[0]=pointAtParameter_6)  # CPython3; same code as createCurveForBeam
elevation_8 = Level.Elevation(level=code_block_43.LevelTop)
translate_6 = Geometry.Translate(geometry=createCurveForBeam_5, zTranslation=elevation_8, lacing=CrossProduct)
실행여부_결정_5 = Python(IN[0]=타이빔_y축_방향_생성_여부_3, IN[1]=translate_6)  # CPython3; same code as 실행여부_결정
beamByCurve_9 = StructuralFraming.BeamByCurve(curve=실행여부_결정_5, level=code_block_43.LevelTop, structuralFramingType=beam_family_types_선택_2, lacing=CrossProduct)  # frozen

# group: 최상층 빔 배치 구간(X 축 방향)
타이빔_x축_방향_생성_여부_3 = BoolSelector(false)  # graph input
code_block_45 = CodeBlock(segmentsX_real=code_block_23, segmentsY_real=code_block_27) { segmentsX_real; segmentsY_real; LevelTop; }  # unwired: LevelTop
transpose_6 = List.Transpose(lists=code_block_45.segmentsY_real)
code_block_46 = CodeBlock { 0.5; }
pointAtParameter_7 = Curve.PointAtParameter(curve=transpose_6, param=code_block_46)
createCurveForBeam_6 = Python(IN[0]=pointAtParameter_7)  # CPython3; same code as createCurveForBeam
elevation_9 = Level.Elevation(level=code_block_45.LevelTop)
translate_7 = Geometry.Translate(geometry=createCurveForBeam_6, zTranslation=elevation_9, lacing=CrossProduct)
실행여부_결정_6 = Python(IN[0]=타이빔_x축_방향_생성_여부_3, IN[1]=translate_7)  # CPython3; same code as 실행여부_결정
beamByCurve_10 = StructuralFraming.BeamByCurve(curve=실행여부_결정_6, level=code_block_45.LevelTop, structuralFramingType=beam_family_types_선택_2, lacing=CrossProduct)  # frozen

# group: 추가 데이터 조작 및 정렬
gridDS_3 = CodeBlock(DataHub=dataHub.DataHub)  # same code as gridDS
code_block_47 = CodeBlock(i=gridDS_3.out21) { i["direction"]=="X_axis"; }
filterByBoolMask_4 = List.FilterByBoolMask(list=gridDS_3.out21, mask=code_block_47)
code_block_48 = CodeBlock(XGridDS=filterByBoolMask_4.in) { XGridDS["segments"]; }
code_block_49 = CodeBlock { 1; }
dropItems_5 = List.DropItems(list=code_block_48@L2, amount=code_block_49)
code_block_50 = CodeBlock { -1; }
dropItems_6 = List.DropItems(list=dropItems_5@L2, amount=code_block_50)
code_block_51 = CodeBlock(segmentsX_real=dropItems_6) { segmentsX_real; }
code_block_52 = CodeBlock(YGridDS=filterByBoolMask_4.out) { YGridDS["segments"]; }
code_block_53 = CodeBlock { 1; }
dropItems_7 = List.DropItems(list=code_block_52@L2, amount=code_block_53)
code_block_54 = CodeBlock { -1; }
dropItems_8 = List.DropItems(list=dropItems_7@L2, amount=code_block_54)
code_block_55 = CodeBlock(segmentsY_real=dropItems_8) { segmentsY_real; }
string_from_web_6 = Python()  # CPython3; unwired: IN[0]; same code as string_from_web
boolean_5 = BoolSelector(true)
code_block_56 = CodeBlock { "B"; }
filterelementsexcepttarget_5 = PythonStringNode(script=string_from_web_6, IN[0]=gridDS_3.out1, IN[1]=boolean_5, IN[2]=code_block_56)  # CPython3

code_block_57 = CodeBlock(segmentsX_real=code_block_51, segmentsY_real=code_block_55, LevelsExceptB=gridDS_3.out2, RoomDS=gridDS_3.out3) { segmentsX_real; segmentsY_real; LevelsExceptB; RoomDS; }

# group: 최상층 찾기
code_block_58 = CodeBlock(LevelsExceptB=code_block_57.LevelsExceptB) { LevelsExceptB; }
elevation_10 = Level.Elevation()  # unwired: level
sortByFunction_2 = List.SortByFunction(list=code_block_58, sortFunction=elevation_10)
list_lastitem_최상층_찾기 = List.LastItem(list=sortByFunction_2)

# group: 최상층 거더 배치 구간(Y 축 방향)
girder_family_types_선택_2 = FamilyTypes("Concrete-Rectangular-Beam:BM111_400x500_RG1")  # graph input
code_block_59 = CodeBlock(segmentsX_real=code_block_23, segmentsY_real=code_block_27, LevelTop=list_lastitem_최상층_찾기) { segmentsX_real; segmentsY_real; LevelTop; }
flatten_12 = List.Flatten(list=code_block_59.segmentsY_real)
elevation_11 = Level.Elevation(level=code_block_59.LevelTop)
translate_8 = Geometry.Translate(geometry=flatten_12, zTranslation=elevation_11, lacing=CrossProduct)
beamByCurve_11 = StructuralFraming.BeamByCurve(curve=translate_8, level=code_block_59.LevelTop, structuralFramingType=girder_family_types_선택_2, lacing=CrossProduct)  # frozen

# group: 최상층 거더 배치 구간(X 축 방향)
code_block_60 = CodeBlock(segmentsX_real=code_block_23, segmentsY_real=code_block_27, LevelTop=list_lastitem_최상층_찾기) { segmentsX_real; segmentsY_real; LevelTop; }
flatten_13 = List.Flatten(list=code_block_60.segmentsX_real)
elevation_12 = Level.Elevation(level=code_block_60.LevelTop)
translate_9 = Geometry.Translate(geometry=flatten_13, zTranslation=elevation_12, lacing=CrossProduct)
beamByCurve_12 = StructuralFraming.BeamByCurve(curve=translate_9, level=code_block_60.LevelTop, structuralFramingType=girder_family_types_선택_2, lacing=CrossProduct)  # frozen

code_block_61 = CodeBlock(LevelsExceptB=gridDS_2.out2) { LevelsExceptB; }
code_block_62 = CodeBlock(i=code_block_57.segmentsX_real) { i; }
elevation_13 = Level.Elevation(level=list_lastitem_최상층_찾기)
translate_10 = Geometry.Translate(geometry=code_block_62, zTranslation=elevation_13)

# group: 최상층 룸 찾기
code_block_63 = CodeBlock(RoomDS=code_block_57.RoomDS) { RoomDS; }
name = Level.Name(level=list_lastitem_최상층_찾기)
code_block_64 = CodeBlock(i=code_block_63, j=name) { i["level"]==j; }
list_filterbyboolmask_최상층_룸_찾기 = List.FilterByBoolMask(list=code_block_63, mask=code_block_64)

code_block_65 = CodeBlock(i=list_filterbyboolmask_최상층_룸_찾기.in) { i["roombottomface"]; }
flatten_14 = List.Flatten(list=code_block_65)
byJoinedSurfaces = PolySurface.ByJoinedSurfaces(surfaces=flatten_14)
perimeterCurves_4 = Surface.PerimeterCurves(surface=byJoinedSurfaces)
byJoinedCurves_3 = PolyCurve.ByJoinedCurves(curves=perimeterCurves_4)
code_block_66 = CodeBlock { -500; }
offset = Curve.Offset(curve=byJoinedCurves_3, distance=code_block_66)
byPatch = Surface.ByPatch(closedCurve=offset)
doesIntersect = Geometry.DoesIntersect(geometry=translate_10@L2, other=byPatch)
filterByBoolMask_5 = List.FilterByBoolMask(list=translate_10@L2, mask=doesIntersect@L2)
flatten_15 = List.Flatten(list=filterByBoolMask_5.in)
code_block_67 = CodeBlock(forBeam=flatten_15) { forBeam; }
code_block_68 = CodeBlock(forBeam=perimeterCurves_4) { forBeam; }
translate_11 = Geometry.Translate(geometry=code_block_68)
code_block_69 = CodeBlock(i=list_filterbyboolmask_최상층_룸_찾기.in) { i["roomupperface"]; }
flatten_16 = List.Flatten(list=code_block_69)
