# Dynamo graph 3_Modelization(1223)_forWall.dyn (Dynamo 2.10.1.3976)

# group: All Levels Elements
categories = Categories("OST_Levels")
all_elements_of_category = ElementsOfCategory(Category=categories)

# group: LevelsExceptB
string_from_web = Python()  # CPython3; unwired: IN[0]
# ---------- string_from_web.python (19 lines) ----------
# Load the Python Standard and DesignScript Libraries
import sys
import clr
clr.AddReference('ProtoGeometry')
from Autodesk.DesignScript.Geometry import *
import urllib.request

# The inputs to this node will be stored as a list in the IN variables.
dataEnteringNode = IN
inputURL = "https://raw.githubusercontent.com/HNANmal/mQ/master/Hdynlib/Revit/Elements/Filtering/FilterElementsExceptTarget.py"

# Place your code below this line
req = urllib.request
data = req.urlopen(inputURL)

result = data.read().decode("utf-8")

# Assign your output to the OUT variable.
OUT = result
# ----------------------------------------
boolean = BoolSelector(false)
code_block = CodeBlock { "B"; }
filterelementsexcepttarget = PythonStringNode(script=string_from_web, IN[0]=all_elements_of_category, IN[1]=boolean, IN[2]=code_block)  # CPython3

# group: All Room Elements
categories_2 = Categories("OST_Rooms")
all_elements_of_category_2 = ElementsOfCategory(Category=categories_2)

# group: Create RoomDS(Data Structure)
string_from_web_2 = Python()  # CPython3; unwired: IN[0]
# ---------- string_from_web_2.python (19 lines) ----------
# Load the Python Standard and DesignScript Libraries
import sys
import clr
clr.AddReference('ProtoGeometry')
from Autodesk.DesignScript.Geometry import *
import urllib.request

# The inputs to this node will be stored as a list in the IN variables.
dataEnteringNode = IN
inputURL = "https://raw.githubusercontent.com/HNANmal/mQ/master/Hdynlib/DataStructure/Custom/Rooms/CreateRoomDS.py"

# Place your code below this line
req = urllib.request
data = req.urlopen(inputURL)

result = data.read().decode("utf-8")

# Assign your output to the OUT variable.
OUT = result
# ----------------------------------------
createroomds = PythonStringNode(script=string_from_web_2, IN[1]=all_elements_of_category_2)  # CPython3; unwired: IN[0]

# group: All Grids Elements
categories_3 = Categories("OST_Grids")
all_elements_of_category_3 = ElementsOfCategory(Category=categories_3)

# group: Create GridDS(Data Structure)
python_script_create_gridds = Python(IN[0]=all_elements_of_category_3)  # CPython3
# ---------- python_script_create_gridds.python (80 lines) ----------
# Load the Python Standard and DesignScript Libraries
import sys
import clr
clr.AddReference('ProtoGeometry')
from Autodesk.DesignScript.Geometry import *

clr.AddReference('RevitAPI')
from Autodesk.Revit.DB import *

clr.AddReference("RevitServices")
import RevitServices
from RevitServices.Persistence import DocumentManager
from RevitServices.Transactions import TransactionManager

clr.AddReference("RevitNodes")
import Revit

doc = DocumentManager.Instance.CurrentDBDocument
from itertools import chain
from collections import defaultdict

# The inputs to this node will be stored as a list in the IN variables.
dataEnteringNode = IN

allgrids = IN[0]

def Create_GridDS(grid, allgrids):
    def findDirection(grid):
        gridVector = grid.Curve.Direction.Normalized()
        if gridVector.IsParallel(Vector.XAxis()):
            return "X_axis"
        else:
            return "Y_axis"
            
    x_Grids = list(filter(lambda i: findDirection(i) == "X_axis", allgrids))
    y_Grids = list(filter(lambda i: findDirection(i) == "Y_axis", allgrids))
    
    intPtsDict = []
    if findDirection(grid) == "X_axis":
        for i in y_Grids:
            tmp = {}
            mark = '-'.join([grid.Name, i.Name])
            tmp[f'{mark}'] = grid.Curve.Intersect(i.Curve)
            intPtsDict.append(tmp)
        
    else:
        for i in x_Grids:
            tmp = {}
            mark = '-'.join([i.Name, grid.Name])
            tmp[f'{mark}'] = grid.Curve.Intersect(i.Curve)
            intPtsDict.append(tmp)
        
    _intPts = list(map(lambda i: i.values(), intPtsDict))
    intPts = list(chain(*chain(*_intPts)))
    gridName = grid.Name
    gridCrv = grid.Curve
    gridVector = gridCrv.Direction.Normalized()
    direction = findDirection(grid)
    segments = gridCrv.SplitByPoints(intPts)
    
    result = {
        "element": grid,
        "gridName": gridName,
        "gridCrv": gridCrv,
        "gridVector": gridVector,
        "direction": direction,
        "intPtsDict": intPtsDict,
        "intPts": intPts,
        "segments": segments
        }
    return result
    

# Place your code below this line

all_GridDS = list(map(lambda i: Create_GridDS(i, allgrids), allgrids))

result = all_GridDS
# Assign your output to the OUT variable.
OUT = result
# ----------------------------------------

dataHub = CodeBlock(AllLevels=all_elements_of_category, LevelsExceptB=filterelementsexcepttarget, RoomDS=createroomds, GridDS=python_script_create_gridds)
# ---------- dataHub.designscript (10 lines) ----------
DataHub = {
	"AllLevels": AllLevels,
	"LevelsExceptB": LevelsExceptB,
	"RoomDS": RoomDS,
	"GridDS": GridDS
};
DataHub["AllLevels"];
DataHub["LevelsExceptB"];
DataHub["RoomDS"];
DataHub["GridDS"];
# ----------------------------------------

# group: 추가 데이터 조작 및 정렬
string_from_web_3 = Python()  # CPython3; unwired: IN[0]; same code as string_from_web
gridDS = CodeBlock(DataHub=dataHub.DataHub)
# ---------- gridDS.designscript (30 lines) ----------
DataHub;
DataHub["AllLevels"];
DataHub["LevelsExceptB"];
DataHub["RoomDS"];
DataHub["RoomDS"]["name"];
DataHub["RoomDS"]["level"];
DataHub["RoomDS"]["department"];
DataHub["RoomDS"]["roomelem"];
DataHub["RoomDS"]["roomsolid"];
DataHub["RoomDS"]["basefinish"];
DataHub["RoomDS"]["ceilfinish"];
DataHub["RoomDS"]["wallfinish"];
DataHub["RoomDS"]["floorfinish"];
DataHub["RoomDS"]["rooffinish"];
DataHub["RoomDS"]["extwallfinish"];
DataHub["RoomDS"]["roomsideface"];
DataHub["RoomDS"]["roomupperface"];
DataHub["RoomDS"]["roombottomface"];
DataHub["RoomDS"]["roomperimeter"];
DataHub["RoomDS"]["adjrooms"];
DataHub["RoomDS"]["surfacedict"];
DataHub["GridDS"];
DataHub["GridDS"]["element"];
DataHub["GridDS"]["gridName"];
DataHub["GridDS"]["gridCrv"];
DataHub["GridDS"]["gridVector"];
DataHub["GridDS"]["direction"];
DataHub["GridDS"]["intPtsDict"];
DataHub["GridDS"]["intPts"];
DataHub["GridDS"]["segments"];
# ----------------------------------------
boolean_2 = BoolSelector(true)
code_block_2 = CodeBlock { "B"; }
filterelementsexcepttarget_2 = PythonStringNode(script=string_from_web_3, IN[0]=gridDS.out1, IN[1]=boolean_2, IN[2]=code_block_2)  # CPython3
code_block_3 = CodeBlock { "level"; }
valueAtKey = DesignScript.Builtin.Dictionary.ValueAtKey(key=code_block_3)  # unwired: dictionary
groupByFunction = List.GroupByFunction(list=gridDS.out3, groupFunction=valueAtKey)
code_block_4 = CodeBlock(i=groupByFunction) { i["level"]; }
perimeterCurves = Surface.PerimeterCurves()  # unwired: surface
byJoinedCurves = PolyCurve.ByJoinedCurves(curves=perimeterCurves)  # frozen
code_block_5 = CodeBlock(i=groupByFunction) { i["surfacedict"]; }

code_block_6 = CodeBlock(i=code_block_5) { i["Ext Surfaces"]; }
code_block_7 = CodeBlock(i=code_block_5) { i["Int Surfaces"]; }

# group (continued): 추가 데이터 조작 및 정렬
flatten = List.Flatten(list=code_block_7@L3)

code_block_8 = CodeBlock(i=flatten) { i[3]; }
python_script = Python(IN[0]=code_block_8)  # CPython3; frozen
# ---------- python_script.python (65 lines) ----------
# Load the Python Standard and DesignScript Libraries
import sys
import clr
clr.AddReference('ProtoGeometry')
from Autodesk.DesignScript.Geometry import *

# The inputs to this node will be stored as a list in the IN variables.
dataEnteringNode = IN
surfaces = IN[0]

# Place your code below this line

#def findintscsurfaces(surfaces):
#    result = []
#    for i in surfaces:
#        tmp1 = []
#        reflist = surfaces.copy()
#        target = i
#        target_bdry = PolyCurve.ByJoinedCurves(i.PerimeterCurves())
#        target_bdry_offset = target_bdry.Offset(-100)
#        targetIdx = surfaces.index(i)
#        tmp1.append(i)
#        
#        del reflist[targetIdx]
#        for j in reflist:
#            if j.DoesIntersect(target_bdry_offset):
#                tmp1.append(j)
#                refIdx = reflist.index(j)
#                del reflist[refIdx]
#            else:
#                pass
#        result.append(tmp1)
#        del surfaces[targetIdx]
#    return result


def findintscsurfaces(surfaces):
    result = []
    remainlist = surfaces.copy()
    def findsurfaces(surface, remainlist):
        surface_bdry = PolyCurve.ByJoinedCurves(surface.PerimeterCurves())
        surface_bdry_offset = surface_bdry.Offset(-100)
        targetsrf = Surface.ByPatch(surface_bdry_offset)
        tmp = []
        tmp.append(surface)
        for i in remainlist:
            if i.DoesIntersect(targetsrf):
                tmp.append(i)
                idx = remainlist.index(i)
                del remainlist[idx]
            else:
                pass
        return [tmp, remainlist]
    for i in remainlist:
        tmp = findsurfaces(i, remainlist)
              
        result.append(tmp[0])
        #remainlist = tmp[1]
    return result
        


result = findintscsurfaces(surfaces)
# Assign your output to the OUT variable.
OUT = result
# ----------------------------------------
code_block_9 = CodeBlock(i=groupByFunction) { i["adjrooms"]; }
categories_4 = Categories("OST_RoomSeparationLines")
all_elements_of_category_4 = ElementsOfCategory(Category=categories_4)
parameters = Element.Parameters(element=all_elements_of_category_4)
geometry = Element.Geometry(element=all_elements_of_category_4)
flatten_2 = List.Flatten(list=geometry)
startPoint = Curve.StartPoint(curve=flatten_2)
Z = Point.Z(point=startPoint)
uniqueItems = List.UniqueItems(list=Z)
allIndicesOf = List.AllIndicesOf(list=Z, item=uniqueItems)
getItemAtIndex = List.GetItemAtIndex(list=flatten_2, index=allIndicesOf)
code_block_10 = CodeBlock(i=getItemAtIndex) { i[3]; }
perimeterCurves_2 = Surface.PerimeterCurves()  # unwired: surface
