# Dynamo graph 4_Bidding Quantity Calculation(1231).dyn (Dynamo 2.10.1.3976)

# group: WM data 부여 구간

# group: Discipline data 부여 구간

# group: Room Name data 부여 구간

# group: Quantities data 전처리 구간

# group: Quantities data 최종계산 및 부여 구간

# group: All Room Elements
categories = Categories("OST_Rooms")
all_elements_of_category = ElementsOfCategory(Category=categories)  # frozen
parameters = Element.Parameters(element=all_elements_of_category)

# group: Room Elements 들의 속성값 추출
code_block = CodeBlock { "Exterior Finish"; }
getParameterValueByName = Element.GetParameterValueByName(element=all_elements_of_category, parameterName=code_block)
code_block_2 = CodeBlock { "Interior Finish"; }
getParameterValueByName_2 = Element.GetParameterValueByName(element=all_elements_of_category, parameterName=code_block_2)
name = Element.Name(element=all_elements_of_category)
code_block_3 = CodeBlock { "Department"; }
getParameterValueByName_3 = Element.GetParameterValueByName(element=all_elements_of_category, parameterName=code_block_3)
code_block_4 = CodeBlock { "Area"; }
getParameterValueByName_4 = Element.GetParameterValueByName(element=all_elements_of_category, parameterName=code_block_4)
code_block_5 = CodeBlock(t1=getParameterValueByName_4) { num2 = (Math.Round(t1, 2)/1); }
code_block_6 = CodeBlock { "Perimeter"; }
getParameterValueByName_5 = Element.GetParameterValueByName(element=all_elements_of_category, parameterName=code_block_6)
code_block_7 = CodeBlock(t1=getParameterValueByName_5) { num2 = (Math.Round(t1, 2)/1000); }

code_block_8 = CodeBlock { "Unbounded Height"; }
getParameterValueByName_6 = Element.GetParameterValueByName(element=all_elements_of_category, parameterName=code_block_8)
uniqueItems = List.UniqueItems(list=getParameterValueByName_6)
firstItem = List.FirstItem(list=uniqueItems)
watch = Watch(getParameterValueByName_2)

# group: Interior Finish Type 별 WM define
interior_finish_type = CodeBlock()
# ---------- interior_finish_type.designscript (9 lines) ----------
[
"NA",
"IF1",
"IF2",
"IF2-1",
"IF3",
"IF4",
"IF5"
];
# ----------------------------------------
interior_finish_floor = CodeBlock()
# ---------- interior_finish_floor.designscript (9 lines) ----------
[
["na...na...na"],
["A04AL080-00006...Epoxy paint(Floor)...M2"],
["A04AM083-00004...Vinyl Tile(Floor)...M2"],
["A04AM083-00004...Vinyl Tile(Floor)...M2"],
["A04AM083-00005...Anti-Static Vinyl Tile(Floor)...M2"],
["A04AL080-00003...Acid/Alkaline Resistant Paint(Floor)...M2"],
["A04AM083-00001...Ceramic Tile(Floor)...M2", "A04AN000-00001...Waterproofing Membrane(Floor)...M2"]
];
# ----------------------------------------
interior_finish_wall = CodeBlock()
# ---------- interior_finish_wall.designscript (12 lines) ----------
[
["na...na...na"],
["A04AL078-00003...Latex Paint(Wall)...M2"],
["A04AL078-00003...Latex Paint(Wall)...M2"],
["A04AL078-00003...Latex Paint(Wall)...M2"],
["A04AL078-00003...Latex Paint(Wall)...M2"],
["A04AL078-00004...Acid/Alkaline Resistant Paint, H=1.5(Wall)...M2",
"A04AL078-00003...Latex Paint(Wall)...M2"],
["A04AM082-00002...Glazed Ceramic Tile, H=1.8(Wall)...M2",
"A04AN000-00001...Waterproofing Membrane, H=1.8m(Wall)...M2",
"A04AL078-00003...Latex Paint(Wall)...M2"]
];
# ----------------------------------------
interior_finish_skirt = CodeBlock()
# ---------- interior_finish_skirt.designscript (9 lines) ----------
[
["na...na...na"],
["A04AL081-00007...Epoxy paint H=100(Skirt)...M"],
["A04AR151-00001...Coved Rubber Skirting, H=100(Skirt)...M"],
["A04AR151-00001...Coved Rubber Skirting, H=100(Skirt)...M"],
["A04AR151-00001...Coved Rubber Skirting, H=100(Skirt)...M"],
["A04AL081-00004...Acid/Alkaline Resistant Paint H=100(Skirt)...M"],
["A04AM084-00004...Glazed Ceramic Tile, H=100(Skirt)...M"]
];
# ----------------------------------------
interior_finish_ceiling = CodeBlock()
# ---------- interior_finish_ceiling.designscript (9 lines) ----------
[
["na...na...na"],
["A04AL079-00003...Latex Paint(Ceiling)...M2"],
["A04AL079-00003...Latex Paint(Ceiling)...M2"],
["A04AR156-00002...Acoustic Tiled Ceiling System, T-Bar(Ceiling)...M2"],
["A04AR156-00002...Acoustic Tiled Ceiling System, T-Bar(Ceiling)...M2"],
["A04AL079-00003...Latex Paint(Ceiling)...M2"],
["A04AR157-00002...Moisture Resistant Tiled Ceiling System, T-bar(Ceiling)...M2"]
];
# ----------------------------------------

allIndicesOf = List.AllIndicesOf(list=watch, item=interior_finish_type)
file_path = Filename(".\test1.xslx")
code_block_9 = CodeBlock { "Sheet1"; }
code_block_10 = CodeBlock { 0; }
watch_room_name = Watch(name)
watch_department = Watch(getParameterValueByName_3)

# group: WM 별 계산 수식 매칭 구간
interior_finish_floor_calc = CodeBlock()
# ---------- interior_finish_floor_calc.designscript (9 lines) ----------
[
[0],//NA
[1],
[1],
[1],
[1],
[1],
[1]
];
# ----------------------------------------
code_block_11 = CodeBlock(i=interior_finish_floor, j=interior_finish_floor_calc) { i + "..." + j; }
watch_2 = Watch(code_block_11)
code_block_12 = CodeBlock { 4; }
interior_finish_wall_calc = CodeBlock(h=code_block_12)
# ---------- interior_finish_wall_calc.designscript (12 lines) ----------
[
[0],
[h],
[h],
[h],
[h],
[1.5,
(h-1.5)],
[1.8,
1.8,
(h-1.8)]
];
# ----------------------------------------
code_block_13 = CodeBlock(i=interior_finish_wall, j=interior_finish_wall_calc) { i + "..." + j; }
watch_3 = Watch(code_block_13)
interior_finish_skirt_calc = CodeBlock()
# ---------- interior_finish_skirt_calc.designscript (9 lines) ----------
[
[0],
[1],
[1],
[1],
[1],
[1],
[1]
];
# ----------------------------------------
code_block_14 = CodeBlock(i=interior_finish_skirt, j=interior_finish_skirt_calc) { i + "..." + j; }
watch_4 = Watch(code_block_14)
interior_finish_ceiling_calc = CodeBlock()  # same code as interior_finish_skirt_calc
code_block_15 = CodeBlock(i=interior_finish_ceiling, j=interior_finish_ceiling_calc) { i + "..." + j; }
watch_5 = Watch(code_block_15)

# group (continued): Interior Finish Type 별 WM define
dictionary_bykeysvalues_floor = DesignScript.Builtin.Dictionary.ByKeysValues(keys=interior_finish_type, values=watch_2)
dictionary_bykeysvalues_wall = DesignScript.Builtin.Dictionary.ByKeysValues(keys=interior_finish_type, values=watch_3)
dictionary_bykeysvalues_skirt = DesignScript.Builtin.Dictionary.ByKeysValues(keys=interior_finish_type, values=watch_4)
dictionary_bykeysvalues_ceiling = DesignScript.Builtin.Dictionary.ByKeysValues(keys=interior_finish_type, values=watch_5)

# group: 개체별 해당 WM 부여
watch_6 = Watch(getParameterValueByName_2)
valueAtKey = DesignScript.Builtin.Dictionary.ValueAtKey(dictionary=dictionary_bykeysvalues_floor, key=watch_6)
watch_wm_floor = Watch(valueAtKey)
valueAtKey_2 = DesignScript.Builtin.Dictionary.ValueAtKey(dictionary=dictionary_bykeysvalues_wall, key=watch_6)
watch_wm_wall = Watch(valueAtKey_2)
valueAtKey_3 = DesignScript.Builtin.Dictionary.ValueAtKey(dictionary=dictionary_bykeysvalues_skirt, key=watch_6)
watch_wm_skirt = Watch(valueAtKey_3)
valueAtKey_4 = DesignScript.Builtin.Dictionary.ValueAtKey(dictionary=dictionary_bykeysvalues_ceiling, key=watch_6)
watch_wm_ceiling = Watch(valueAtKey_4)

# group: WM 개수당 개체 복제 후 매칭<Floor>
count = List.Count(list=watch_wm_floor@L2)
ofRepeatedItem = List.OfRepeatedItem(item=watch_6@L1, amount=count@L1)
code_block_16 = CodeBlock(a=ofRepeatedItem, b=watch_wm_floor) { a + "..." + b; }

# group: WM 개수당 개체 복제 후 매칭<Floor>
count_2 = List.Count(list=code_block_16@L2)
ofRepeatedItem_2 = List.OfRepeatedItem(item=watch_department@L1, amount=count_2@L1)
code_block_17 = CodeBlock(a=ofRepeatedItem_2, b=code_block_16) { a + "..." + b; }

# group: WM 개수당 개체 복제 후 매칭<Floor>
count_3 = List.Count(list=code_block_17@L2)
ofRepeatedItem_3 = List.OfRepeatedItem(item=watch_room_name@L1, amount=count_3@L1)
code_block_18 = CodeBlock(a=ofRepeatedItem_3, b=code_block_17) { a + "..." + b; }

watch_7 = Watch(code_block_18)
watch_room_area = Watch(code_block_5)

# group: WM 개수당 개체 복제 후 매칭<Floor>
count_4 = List.Count(list=watch_7@L2)
ofRepeatedItem_4 = List.OfRepeatedItem(item=watch_room_area@L1, amount=count_4@L1)
code_block_19 = CodeBlock(b=watch_7, a=ofRepeatedItem_4) { b + "..." + a; }

watch_8 = Watch(code_block_19)

# group: WM 개수당 개체 복제 후 매칭<Wall>
count_5 = List.Count(list=watch_wm_wall@L2)
ofRepeatedItem_5 = List.OfRepeatedItem(item=watch_6@L1, amount=count_5@L1)
code_block_20 = CodeBlock(a=ofRepeatedItem_5, b=watch_wm_wall) { a + "..." + b; }

# group: WM 개수당 개체 복제 후 매칭<Wall>
count_6 = List.Count(list=code_block_20@L2)
ofRepeatedItem_6 = List.OfRepeatedItem(item=watch_department@L1, amount=count_6@L1)
code_block_21 = CodeBlock(a=ofRepeatedItem_6, b=code_block_20) { a + "..." + b; }

# group: WM 개수당 개체 복제 후 매칭<Wall>
count_7 = List.Count(list=code_block_21@L2)
ofRepeatedItem_7 = List.OfRepeatedItem(item=watch_room_name@L1, amount=count_7@L1)
code_block_22 = CodeBlock(a=ofRepeatedItem_7, b=code_block_21) { a + "..." + b; }

watch_9 = Watch(code_block_22)
watch_room_perimeter = Watch(code_block_7)

# group: WM 개수당 개체 복제 후 매칭<Wall>
count_8 = List.Count(list=watch_9@L2)
ofRepeatedItem_8 = List.OfRepeatedItem(item=watch_room_perimeter@L1, amount=count_8@L1)
code_block_23 = CodeBlock(b=watch_9, a=ofRepeatedItem_8) { b + "..." + a; }

watch_10 = Watch(code_block_23)

# group: WM 개수당 개체 복제 후 매칭<Skirt>
count_9 = List.Count(list=watch_wm_skirt@L2)
ofRepeatedItem_9 = List.OfRepeatedItem(item=watch_6@L1, amount=count_9@L1)
code_block_24 = CodeBlock(a=ofRepeatedItem_9, b=watch_wm_skirt) { a + "..." + b; }

# group: WM 개수당 개체 복제 후 매칭<Skirt>
count_10 = List.Count(list=code_block_24@L2)
ofRepeatedItem_10 = List.OfRepeatedItem(item=watch_department@L1, amount=count_10@L1)
code_block_25 = CodeBlock(a=ofRepeatedItem_10, b=code_block_24) { a + "..." + b; }

# group: WM 개수당 개체 복제 후 매칭<Skirt>
count_11 = List.Count(list=code_block_25@L2)
ofRepeatedItem_11 = List.OfRepeatedItem(item=watch_room_name@L1, amount=count_11@L1)
code_block_26 = CodeBlock(a=ofRepeatedItem_11, b=code_block_25) { a + "..." + b; }

watch_11 = Watch(code_block_26)

# group: WM 개수당 개체 복제 후 매칭<Wall>
count_12 = List.Count(list=watch_11@L2)
ofRepeatedItem_12 = List.OfRepeatedItem(item=watch_room_perimeter@L1, amount=count_12@L1)
code_block_27 = CodeBlock(b=watch_11, a=ofRepeatedItem_12) { b + "..." + a; }

watch_12 = Watch(code_block_27)

# group: WM 개수당 개체 복제 후 매칭<Ceiling>
count_13 = List.Count(list=watch_wm_ceiling@L2)
ofRepeatedItem_13 = List.OfRepeatedItem(item=watch_6@L1, amount=count_13@L1)
code_block_28 = CodeBlock(a=ofRepeatedItem_13, b=watch_wm_ceiling) { a + "..." + b; }

# group: WM 개수당 개체 복제 후 매칭<Ceiling>
count_14 = List.Count(list=code_block_28@L2)
ofRepeatedItem_14 = List.OfRepeatedItem(item=watch_department@L1, amount=count_14@L1)
code_block_29 = CodeBlock(a=ofRepeatedItem_14, b=code_block_28) { a + "..." + b; }

# group: WM 개수당 개체 복제 후 매칭<Ceiling>
count_15 = List.Count(list=code_block_29@L2)
ofRepeatedItem_15 = List.OfRepeatedItem(item=watch_room_name@L1, amount=count_15@L1)
code_block_30 = CodeBlock(a=ofRepeatedItem_15, b=code_block_29) { a + "..." + b; }

watch_13 = Watch(code_block_30)

# group: WM 개수당 개체 복제 후 매칭<Ceiling>
count_16 = List.Count(list=watch_13@L2)
ofRepeatedItem_16 = List.OfRepeatedItem(item=watch_room_area@L1, amount=count_16@L1)
code_block_31 = CodeBlock(b=watch_13, a=ofRepeatedItem_16) { b + "..." + a; }

watch_14 = Watch(code_block_31)
list_create = List.Create(item0=watch_8, item1=watch_10, item2=watch_12, item3=watch_14)
code_block_32 = CodeBlock { "..."; }
split = String.Split(str=list_create, separator0=code_block_32)
code_block_33 = CodeBlock { 2; }
flatten = List.Flatten(list=split, amt=code_block_33)
code_block_34 = CodeBlock(str1=flatten)
# ---------- code_block_34.designscript (4 lines) ----------
t1 =
String.ToNumber(List.GetItemAtIndex(str1@L2<1>, 6))
*
String.ToNumber(List.GetItemAtIndex(str1@L2<1>, 7));
# ----------------------------------------
watch_15 = Watch(code_block_34)
addItemToEnd = List.AddItemToEnd(item=watch_15@L1, list=flatten@L2)

# group: Export Excel(By OpenpyXl)
firstItem_2 = List.FirstItem()  # unwired: list
sortByFunction = List.SortByFunction(list=addItemToEnd, sortFunction=firstItem_2)
python_script_export_excel_by = Python(IN[0]=sortByFunction)  # "Python Script@Export Excel(By OpenpyXl)"; CPython3
# ---------- python_script_export_excel_by.python (151 lines) ----------
# Load the Python Standard and DesignScript Libraries
import sys
import os
#sys.path.append(r'C:\Users\HEC\AppData\Local\Programs\Python\Python39\Lib\site-packages')
#sys.path.append(r'C:\Users\pjmk0\AppData\Local\Programs\Python\Python39\Lib\site-packages')
sys.path.append(os.getenv('LOCALAPPDATA').replace('\\','\\\\') + r'\Programs\Python\Python39\Lib\site-packages')
import clr
clr.AddReference('ProtoGeometry')
from Autodesk.DesignScript.Geometry import *
from collections import Iterable

def iterable(obj):
    return isinstance(obj, Iterable)


# The inputs to this node will be stored as a list in the IN variables.
dataEnteringNode = IN
ListIn = IN[0]

# Place your code below this line
import datetime
from datetime import date, timedelta
Today = date.today()
import openpyxl
from openpyxl.styles import Border, Side, PatternFill, Font, GradientFill, Alignment, Color, numbers

sample_items = ListIn


def write_to_file(filepath):
    wb = openpyxl.Workbook()
    for sheet in wb.sheetnames:
        wb.remove(wb[sheet])

    thin = Side(border_style="thin", color="000000")
    double = Side(border_style="double", color="000000")

    ws = wb.create_sheet(title='Wall_Calc_instance', index=0)

    ws.merge_cells('A1:L1')
    ws['A1'] = 'HEC Bidding Calculation Sheet'
    cell = ws['A1']
    cell.font = openpyxl.styles.Font(color='000000', size=20)
    cell.fill = openpyxl.styles.fills.PatternFill(patternType='solid',
                                                  fgColor=openpyxl.styles.colors.Color(rgb='fff3b0'))

    ws['A2'] = 'Item Number'
    ws['A2'].font = openpyxl.styles.Font(b=True, color='000000', size=12)
    ws['B2'] = 'Room Name'
    ws['B2'].font = openpyxl.styles.Font(b=True, color='000000', size=12)
    ws['C2'] = 'Department'
    ws['C2'].font = openpyxl.styles.Font(b=True, color='000000', size=12)
    ws['D2'] = 'Interior Finish Type'
    ws['D2'].font = openpyxl.styles.Font(b=True, color='000000', size=12)
    ws['E2'] = 'WorkMaster Code'
    ws['E2'].font = openpyxl.styles.Font(b=True, color='000000', size=12)
    ws['F2'] = 'WorkMaster Description'
    ws['F2'].font = openpyxl.styles.Font(b=True, color='000000', size=12)
    ws['G2'] = 'Unit'
    ws['G2'].font = openpyxl.styles.Font(b=True, color='000000', size=12)
    ws['H2'] = '계수'
    ws['H2'].font = openpyxl.styles.Font(b=True, color='000000', size=12)
    ws['I2'] = '계산 참조값'
    ws['I2'].font = openpyxl.styles.Font(b=True, color='000000', size=12)
    ws['J2'] = 'Quantities'
    ws['J2'].font = openpyxl.styles.Font(b=True, color='000000', size=12)
    ws['K2'] = 'Unit Price'
    ws['K2'].font = openpyxl.styles.Font(b=True, color='000000', size=12)
    ws['L2'] = 'Total Price'
    ws['L2'].font = openpyxl.styles.Font(b=True, color='000000', size=12)


## 칼럼별 너비 조정 구간
#    for col in range(ws.max_column):
#        ws.column_dimensions[chr(ord('A') + col)].width = 15
    ws.column_dimensions['A'].width = 15
    ws.column_dimensions['B'].width = 25
    ws.column_dimensions['C'].width = 12
    ws.column_dimensions['D'].width = 20
    ws.column_dimensions['E'].width = 20
    ws.column_dimensions['F'].width = 52
    ws.column_dimensions['G'].width = 9
    #ws.column_dimensions['H'].width = 9
    ws.column_dimensions['H'].hidden = True
    #ws.column_dimensions['I'].width = 12
    ws.column_dimensions['I'].hidden = True
    ws.column_dimensions['J'].width = 12
    ws.column_dimensions['K'].width = 12
    ws.column_dimensions['L'].width = 12

###
    start_row = 3
    for (row, item) in enumerate(sample_items, start_row):
        cell = ws.cell(row=row, column=1, value=row - 2)
        cell.alignment = openpyxl.styles.Alignment(horizontal='center', vertical='center')

#        cell = ws.cell(row=row, column=2, value=item[0])
#        cell.number_format = openpyxl.styles.numbers.FORMAT_DATE_YYYYMMDD2  # 'yyyy-mm-dd'
        ws.cell(row=row, column=2, value=item[0]) ## Room Name 칼럼

        ws.cell(row=row, column=3, value=item[1]) ## Department 칼럼
        
        ws.cell(row=row, column=4, value=item[2]) ## Interior Finish Type 칼럼
        
        ws.cell(row=row, column=5, value=item[3]) ## WorkMaster Code 칼럼
        
        ws.cell(row=row, column=6, value=item[4]) ## WorkMaster Description 칼럼
        
        ws.cell(row=row, column=7, value=item[5]) ## Unit 칼럼

        cell = ws.cell(row=row, column=8, value=item[6]) ## 계수 칼럼
        cell.number_format = openpyxl.styles.numbers.builtin_format_code(3)  # '#,##0'
        
        cell = ws.cell(row=row, column=9, value=item[7]) ## 계산 참조값 칼럼
        cell.number_format = openpyxl.styles.numbers.builtin_format_code(3)  # '#,##0'
        
        cell = ws.cell(row=row, column=10, value=item[8]) ## Quantities 칼럼
        cell.number_format = openpyxl.styles.numbers.builtin_format_code(3)  # '#,##0'
        cell.font = openpyxl.styles.Font(b=True, color='000000', size=11)

        cell = ws.cell(row=row, column=12, value='= J{current_row}*K{current_row}'.format(current_row=cell.row))
        cell.number_format = '#,##0'

#        cell = ws.cell(row=row, column=6, value='= D{current_row} * E{current_row}'.format(current_row=cell.row))
#        cell.number_format = openpyxl.styles.numbers.builtin_format_code(3)

    total_row = ws.max_row + 1
    if total_row > start_row:
        cell1 = ws.cell(row=total_row, column=11, value='Total')
        cell1.font = openpyxl.styles.Font(b=True, color='000000', size=15)
        
        cell2 = ws.cell(row=total_row, column=12, value='= SUM(L{}:L{})'.format(start_row, total_row - 1))
        cell2.number_format = openpyxl.styles.numbers.builtin_format_code(3)
        cell2.border = Border(top=double, left=double, right=double, bottom=double)
        cell2.font = openpyxl.styles.Font(b=True, color='ff03ce', size=15)
    

    wb.save(filepath)
    wb.close()


##if __name__ == '__main__':
#write_to_file('C:\\Users\\pjmk0\\AppData\\Roaming\\test.xlsx')
save_name = "HecBiddingCalcSheet_" + Today.strftime("%Y-%m-%d")+".xlsx"
path = os.getenv('APPDATA').replace('\\','\\\\')
filePath = path + '\\' + save_name

write_to_file(filePath)

# Assign your output to the OUT variable.
OUT = os.getenv('APPDATA')
# ----------------------------------------

code_block_35 = CodeBlock { true; }
exportExcel = Data.ExportExcel(filePath=file_path, sheetName=code_block_9, startRow=code_block_10, startCol=code_block_10, data=sortByFunction, overWrite=code_block_35)  # frozen

# group: All Room Elements
categories_2 = Categories("OST_Rooms")
all_elements_of_category_2 = ElementsOfCategory(Category=categories_2)

parameters_2 = Element.Parameters(element=all_elements_of_category_2)

# group: Group by Level
code_block_36 = CodeBlock { "Level"; }
getParameterValueByName_7 = Element.GetParameterValueByName(element=all_elements_of_category_2, parameterName=code_block_36, lacing=CrossProduct)
uniqueItems_2 = List.UniqueItems(list=getParameterValueByName_7)
allIndicesOf_2 = List.AllIndicesOf(list=getParameterValueByName_7, item=uniqueItems_2)
getItemAtIndex = List.GetItemAtIndex(list=all_elements_of_category_2, index=allIndicesOf_2)

code_block_37 = CodeBlock()
# ---------- code_block_37.designscript (8 lines) ----------
//층별 내외부 판별 매스 만들기

//물량 산출에 필요한 기준 형상
//룸 바닥 테두리 curve (for skirt)
//룸 측면 surface
//벽 공종 적용 높이
//박스 측면 surface(외벽 산출의 경우)
//
# ----------------------------------------
code_block_38 = CodeBlock()
# ---------- code_block_38.designscript (5 lines) ----------
//<finishTypeclass>
//name
//참조 WM+description
//참조 형상
//산출 범위 in 참조형상
# ----------------------------------------

# group: All Box Elements
categories_3 = Categories("OST_GenericModel")
all_elements_of_category_3 = ElementsOfCategory(Category=categories_3)
string_from_object = FromObject(object=all_elements_of_category_3)
code_block_39 = CodeBlock { "Space Planning Box"; }
contains = String.Contains(str=string_from_object, searchFor=code_block_39)
filterByBoolMask = List.FilterByBoolMask(list=all_elements_of_category_3, mask=contains)

code_block_40 = CodeBlock { "Room Name"; }
getParameterValueByName_8 = Element.GetParameterValueByName(element=filterByBoolMask.in, parameterName=code_block_40)

# group: Filtering Level(Room 배치 대상 레벨)
string_from_web = Python()  # CPython3; unwired: IN[0]
# ---------- string_from_web.python (19 lines) ----------
# Load the Python Standard and DesignScript Libraries
import sys
import clr
clr.AddReference('ProtoGeometry')
from Autodesk.DesignScript.Geometry import *
import urllib.request

# The inputs to this node will be stored as a list in the IN variables.
dataEnteringNode = IN
inputURL = "https://raw.githubusercontent.com/HNANmal/mQ/master/Hdynlib/Revit/Elements/Filtering/FilterElementsExceptTarget.py"

# Place your code below this line
req = urllib.request
data = req.urlopen(inputURL)

result = data.read().decode("utf-8")

# Assign your output to the OUT variable.
OUT = result
# ----------------------------------------
categories_4 = Categories("OST_Levels")
all_elements_of_category_4 = ElementsOfCategory(Category=categories_4)
지하층_포함여부 = BoolSelector(false)  # graph input
code_block_41 = CodeBlock { "B"; }
selectallelementsexcept = PythonStringNode(script=string_from_web, IN[0]=all_elements_of_category_4, IN[1]=지하층_포함여부, IN[2]=code_block_41)  # CPython3

integer_slider = IntegerSlider(2, range=0..44 step 1)

# group: Create RoomDS
string_from_web_2 = Python()  # CPython3; unwired: IN[0]
# ---------- string_from_web_2.python (19 lines) ----------
# Load the Python Standard and DesignScript Libraries
import sys
import clr
clr.AddReference('ProtoGeometry')
from Autodesk.DesignScript.Geometry import *
import urllib.request

# The inputs to this node will be stored as a list in the IN variables.
dataEnteringNode = IN
inputURL = "https://raw.githubusercontent.com/HNANmal/mQ/master/Hdynlib/DataStructure/Custom/Rooms/CreateRoomDS.py"

# Place your code below this line
req = urllib.request
data = req.urlopen(inputURL)

result = data.read().decode("utf-8")

# Assign your output to the OUT variable.
OUT = result
# ----------------------------------------
createroomds = PythonStringNode(script=string_from_web_2, IN[0]=selectallelementsexcept, IN[1]=all_elements_of_category_2)  # CPython3
code_block_42 = CodeBlock(i=createroomds, j=integer_slider) { i[0]; i[j]; }
roomDS_objects = CodeBlock(result=code_block_42.out1) { result; }

watch_16 = Watch(code_block_42.out0)

# group: Input for Calculation
skirt_height = DoubleInput(100)
wet_area_waterproofing_height = DoubleInput(1500)
chemical_acid_area_resist_height = DoubleInput(1500)

# group: Input_Excel related
file_path_2 = Filename(".\01_Building List_Pilot Project_2021_1211_mk.xlsx")  # graph input
sheet_name = CodeBlock { "Finish Code"; }

# group: Github_Python@Import Excel(By OpenpyXl)
string_from_web_3 = Python()  # CPython3; unwired: IN[0]
# ---------- string_from_web_3.python (19 lines) ----------
# Load the Python Standard and DesignScript Libraries
import sys
import clr
clr.AddReference('ProtoGeometry')
from Autodesk.DesignScript.Geometry import *
import urllib.request

# The inputs to this node will be stored as a list in the IN variables.
dataEnteringNode = IN
inputURL = "https://raw.githubusercontent.com/HNANmal/mQ/master/Laboratory/20211123_%EC%9E%85%EC%B0%B0%EC%9E%90%EB%8F%99%ED%99%94%ED%88%B4Test%20Sample/test.py"

# Place your code below this line
req = urllib.request
data = req.urlopen(inputURL)

result = data.read().decode("utf-8")

# Assign your output to the OUT variable.
OUT = result
# ----------------------------------------
python_script_from_string = PythonStringNode(script=string_from_web_3, IN[0]=file_path_2, IN[1]=sheet_name)  # CPython3

# group: Data bunch 분할_Row기반
code_block_43 = CodeBlock { 2; }
dropItems = List.DropItems(list=python_script_from_string, amount=code_block_43)
string_from_object_2 = FromObject(object=dropItems)
firstItem_3 = List.FirstItem(list=string_from_object_2@L2)
code_block_44 = CodeBlock { "Base Material"; }
contains_2 = String.Contains(str=firstItem_3, searchFor=code_block_44)
code_block_45 = CodeBlock { true; }
allIndicesOf_3 = List.AllIndicesOf(list=contains_2, item=code_block_45)
python_script_data_bunch_분할_행기반 = Python(IN[0]=allIndicesOf_3)  # CPython3
# ---------- python_script_data_bunch_분할_행기반.python (22 lines) ----------
# Load the Python Standard and DesignScript Libraries
import sys
import clr
clr.AddReference('ProtoGeometry')
from Autodesk.DesignScript.Geometry import *

# The inputs to this node will be stored as a list in the IN variables.
dataEnteringNode = IN
inlist = IN[0]

# Place your code below this line
result = []
for i in range(len(inlist)):
    if i < len(inlist)-1:
        sub = inlist[i+1] - inlist[i]
        result.append(sub)
    else:
        pass


# Assign your output to the OUT variable.
OUT = result
# ----------------------------------------
chop = List.Chop(list=dropItems, lengths=python_script_data_bunch_분할_행기반)

# group: 마감 종류별 Dictionary 정리- Roof, Wall, Base, Floor, Ceiling
code_block_46 = CodeBlock { 1; }
getItemAtIndex_2 = List.GetItemAtIndex(list=chop@L3, index=code_block_46)
firstItem_4 = List.FirstItem(list=getItemAtIndex_2@L2)
byKeysValues = DesignScript.Builtin.Dictionary.ByKeysValues(keys=firstItem_4, values=chop)

# group: Finish Type 코드가 있는 Column 인덱스 추출
firstItem_5 = List.FirstItem(list=chop@L3)
code_block_47 = CodeBlock { "Finish"; }
eq = firstItem_5 == code_block_47
code_block_48 = CodeBlock { true; }
allIndicesOf_4 = List.AllIndicesOf(list=eq@L2, item=code_block_48)
flatten_2 = List.Flatten(list=allIndicesOf_4)
uniqueItems_3 = List.UniqueItems(list=flatten_2)
code_block_49 = CodeBlock(i=uniqueItems_3) { i[0]; }

code_block_50 = CodeBlock { "Roof"; "RF"; }

# group: Type 별 WM 추출 - Roof
code_block_51 = CodeBlock(TypeDictionary=byKeysValues, FinishCodeIndex=code_block_49, FinishType=code_block_50.out0, FinishTypeMark=code_block_50.out1)
# ---------- code_block_51.designscript (10 lines) ----------
i={
"TypeDictionary": TypeDictionary,
"FinishCodeIndex": FinishCodeIndex,
"FinishType": FinishType,
"FinishTypeMark": FinishTypeMark
};
i["TypeDictionary"];
i["FinishCodeIndex"];
i["FinishType"];
i["FinishTypeMark"];
# ----------------------------------------
valueAtKey_5 = DesignScript.Builtin.Dictionary.ValueAtKey(dictionary=code_block_51.out1, key=code_block_51.out3)
getItemAtIndex_3 = List.GetItemAtIndex(list=valueAtKey_5@L2, index=code_block_51.out2)
contains_3 = String.Contains(str=getItemAtIndex_3, searchFor=code_block_51.out4)
code_block_52 = CodeBlock { true; }
allIndicesOf_5 = List.AllIndicesOf(list=contains_3, item=code_block_52)
getItemAtIndex_4 = List.GetItemAtIndex(list=valueAtKey_5@L3, index=allIndicesOf_5)
code_block_53 = CodeBlock(i=code_block_51.out2) { i; }
dropItems_2 = List.DropItems(list=getItemAtIndex_4@L2, amount=code_block_53)
firstItem_6 = List.FirstItem(list=dropItems_2@L2)
string_from_object_3 = FromObject(object=dropItems_2)
code_block_54 = CodeBlock { "O"; }
allIndicesOf_6 = List.AllIndicesOf(list=string_from_object_3@L2, item=code_block_54)
python_script_empty_list_indices = Python(IN[0]=allIndicesOf_6)  # CPython3
# ---------- python_script_empty_list_indices.python (19 lines) ----------
# Load the Python Standard and DesignScript Libraries
import sys
import clr
clr.AddReference('ProtoGeometry')
from Autodesk.DesignScript.Geometry import *

# The inputs to this node will be stored as a list in the IN variables.
dataEnteringNode = IN

inlist = IN[0]
# Place your code below this line
result = []
for i in range(len(inlist)):
    if inlist[i]:
        pass
    else:
        result.append(i)
# Assign your output to the OUT variable.
OUT = result
# ----------------------------------------
removeItemAtIndex = List.RemoveItemAtIndex(list=firstItem_6, indices=python_script_empty_list_indices)
code_block_55 = CodeBlock { 2; }
getItemAtIndex_5 = List.GetItemAtIndex(list=valueAtKey_5@L3, index=code_block_55)
dropItems_3 = List.DropItems(list=getItemAtIndex_5@L2, amount=code_block_53)
flatten_3 = List.Flatten(list=dropItems_3)
python_script_empty_list_제거 = Python(IN[0]=allIndicesOf_6)  # CPython3
# ---------- python_script_empty_list_제거.python (19 lines) ----------
# Load the Python Standard and DesignScript Libraries
import sys
import clr
clr.AddReference('ProtoGeometry')
from Autodesk.DesignScript.Geometry import *

# The inputs to this node will be stored as a list in the IN variables.
dataEnteringNode = IN

inlist = IN[0]
# Place your code below this line
result = []
for i in inlist:
    if i:
        result.append(i)
    else:
        pass
# Assign your output to the OUT variable.
OUT = result
# ----------------------------------------
getItemAtIndex_6 = List.GetItemAtIndex(list=flatten_3, index=python_script_empty_list_제거@L2)
code_block_56 = CodeBlock { 1; }
getItemAtIndex_7 = List.GetItemAtIndex(list=valueAtKey_5@L3, index=code_block_56)
dropItems_4 = List.DropItems(list=getItemAtIndex_7@L2, amount=code_block_53)
flatten_4 = List.Flatten(list=dropItems_4)
getItemAtIndex_8 = List.GetItemAtIndex(list=flatten_4, index=python_script_empty_list_제거@L2)
code_block_57 = CodeBlock(a=getItemAtIndex_6, b=getItemAtIndex_8) { a+": "+b; }
byKeysValues_2 = DesignScript.Builtin.Dictionary.ByKeysValues(keys=removeItemAtIndex, values=code_block_57)

code_block_58 = CodeBlock { "Exterior Wall"; "EW"; }

# group: Type 별 WM 추출 - Exterior Wall
code_block_59 = CodeBlock(TypeDictionary=byKeysValues, FinishCodeIndex=code_block_49, FinishType=code_block_58.out0, FinishTypeMark=code_block_58.out1)  # same code as code_block_51
valueAtKey_6 = DesignScript.Builtin.Dictionary.ValueAtKey(dictionary=code_block_59.out1, key=code_block_59.out3)
getItemAtIndex_9 = List.GetItemAtIndex(list=valueAtKey_6@L2, index=code_block_59.out2)
contains_4 = String.Contains(str=getItemAtIndex_9, searchFor=code_block_59.out4)
code_block_60 = CodeBlock { true; }
allIndicesOf_7 = List.AllIndicesOf(list=contains_4, item=code_block_60)
getItemAtIndex_10 = List.GetItemAtIndex(list=valueAtKey_6@L3, index=allIndicesOf_7)
code_block_61 = CodeBlock(i=code_block_59.out2) { i; }
dropItems_5 = List.DropItems(list=getItemAtIndex_10@L2, amount=code_block_61)
firstItem_7 = List.FirstItem(list=dropItems_5@L2)
string_from_object_4 = FromObject(object=dropItems_5)
code_block_62 = CodeBlock { "O"; }
allIndicesOf_8 = List.AllIndicesOf(list=string_from_object_4@L2, item=code_block_62)
python_script_empty_list_indices_2 = Python(IN[0]=allIndicesOf_8)  # CPython3; same code as python_script_empty_list_indices
removeItemAtIndex_2 = List.RemoveItemAtIndex(list=firstItem_7, indices=python_script_empty_list_indices_2)
code_block_63 = CodeBlock { 2; }
getItemAtIndex_11 = List.GetItemAtIndex(list=valueAtKey_6@L3, index=code_block_63)
dropItems_6 = List.DropItems(list=getItemAtIndex_11@L2, amount=code_block_61)
flatten_5 = List.Flatten(list=dropItems_6)
python_script_empty_list_제거_2 = Python(IN[0]=allIndicesOf_8)  # CPython3; same code as python_script_empty_list_제거
getItemAtIndex_12 = List.GetItemAtIndex(list=flatten_5, index=python_script_empty_list_제거_2@L2)
code_block_64 = CodeBlock { 1; }
getItemAtIndex_13 = List.GetItemAtIndex(list=valueAtKey_6@L3, index=code_block_64)
dropItems_7 = List.DropItems(list=getItemAtIndex_13@L2, amount=code_block_61)
flatten_6 = List.Flatten(list=dropItems_7)
getItemAtIndex_14 = List.GetItemAtIndex(list=flatten_6, index=python_script_empty_list_제거_2@L2)
code_block_65 = CodeBlock(a=getItemAtIndex_12, b=getItemAtIndex_14) { a+": "+b; }
byKeysValues_3 = DesignScript.Builtin.Dictionary.ByKeysValues(keys=removeItemAtIndex_2, values=code_block_65)

code_block_66 = CodeBlock { "Interior Wall"; "IW"; }

# group: Type 별 WM 추출 - Interior Wall
code_block_67 = CodeBlock(TypeDictionary=byKeysValues, FinishCodeIndex=code_block_49, FinishType=code_block_66.out0, FinishTypeMark=code_block_66.out1)  # same code as code_block_51
valueAtKey_7 = DesignScript.Builtin.Dictionary.ValueAtKey(dictionary=code_block_67.out1, key=code_block_67.out3)
getItemAtIndex_15 = List.GetItemAtIndex(list=valueAtKey_7@L2, index=code_block_67.out2)
contains_5 = String.Contains(str=getItemAtIndex_15, searchFor=code_block_67.out4)
code_block_68 = CodeBlock { true; }
allIndicesOf_9 = List.AllIndicesOf(list=contains_5, item=code_block_68)
getItemAtIndex_16 = List.GetItemAtIndex(list=valueAtKey_7@L3, index=allIndicesOf_9)
code_block_69 = CodeBlock(i=code_block_67.out2) { i; }
dropItems_8 = List.DropItems(list=getItemAtIndex_16@L2, amount=code_block_69)
firstItem_8 = List.FirstItem(list=dropItems_8@L2)
string_from_object_5 = FromObject(object=dropItems_8)
code_block_70 = CodeBlock { "O"; }
allIndicesOf_10 = List.AllIndicesOf(list=string_from_object_5@L2, item=code_block_70)
python_script_empty_list_indices_3 = Python(IN[0]=allIndicesOf_10)  # CPython3; same code as python_script_empty_list_indices
removeItemAtIndex_3 = List.RemoveItemAtIndex(list=firstItem_8, indices=python_script_empty_list_indices_3)
code_block_71 = CodeBlock { 2; }
getItemAtIndex_17 = List.GetItemAtIndex(list=valueAtKey_7@L3, index=code_block_71)
dropItems_9 = List.DropItems(list=getItemAtIndex_17@L2, amount=code_block_69)
flatten_7 = List.Flatten(list=dropItems_9)
python_script_empty_list_제거_3 = Python(IN[0]=allIndicesOf_10)  # CPython3; same code as python_script_empty_list_제거
getItemAtIndex_18 = List.GetItemAtIndex(list=flatten_7, index=python_script_empty_list_제거_3@L2)
code_block_72 = CodeBlock { 1; }
getItemAtIndex_19 = List.GetItemAtIndex(list=valueAtKey_7@L3, index=code_block_72)
dropItems_10 = List.DropItems(list=getItemAtIndex_19@L2, amount=code_block_69)
flatten_8 = List.Flatten(list=dropItems_10)
getItemAtIndex_20 = List.GetItemAtIndex(list=flatten_8, index=python_script_empty_list_제거_3@L2)
code_block_73 = CodeBlock(a=getItemAtIndex_18, b=getItemAtIndex_20) { a+": "+b; }
byKeysValues_4 = DesignScript.Builtin.Dictionary.ByKeysValues(keys=removeItemAtIndex_3, values=code_block_73)

code_block_74 = CodeBlock { "Interior Base"; "WK"; }

# group: Type 별 WM 추출 - Interior Base
code_block_75 = CodeBlock(TypeDictionary=byKeysValues, FinishCodeIndex=code_block_49, FinishType=code_block_74.out0, FinishTypeMark=code_block_74.out1)  # same code as code_block_51
valueAtKey_8 = DesignScript.Builtin.Dictionary.ValueAtKey(dictionary=code_block_75.out1, key=code_block_75.out3)
getItemAtIndex_21 = List.GetItemAtIndex(list=valueAtKey_8@L2, index=code_block_75.out2)
contains_6 = String.Contains(str=getItemAtIndex_21, searchFor=code_block_75.out4)
code_block_76 = CodeBlock { true; }
allIndicesOf_11 = List.AllIndicesOf(list=contains_6, item=code_block_76)
getItemAtIndex_22 = List.GetItemAtIndex(list=valueAtKey_8@L3, index=allIndicesOf_11)
code_block_77 = CodeBlock(i=code_block_75.out2) { i; }
dropItems_11 = List.DropItems(list=getItemAtIndex_22@L2, amount=code_block_77)
firstItem_9 = List.FirstItem(list=dropItems_11@L2)
string_from_object_6 = FromObject(object=dropItems_11)
code_block_78 = CodeBlock { "O"; }
allIndicesOf_12 = List.AllIndicesOf(list=string_from_object_6@L2, item=code_block_78)
python_script_empty_list_indices_4 = Python(IN[0]=allIndicesOf_12)  # CPython3; same code as python_script_empty_list_indices
removeItemAtIndex_4 = List.RemoveItemAtIndex(list=firstItem_9, indices=python_script_empty_list_indices_4)
code_block_79 = CodeBlock { 2; }
getItemAtIndex_23 = List.GetItemAtIndex(list=valueAtKey_8@L3, index=code_block_79)
dropItems_12 = List.DropItems(list=getItemAtIndex_23@L2, amount=code_block_77)
flatten_9 = List.Flatten(list=dropItems_12)
python_script_empty_list_제거_4 = Python(IN[0]=allIndicesOf_12)  # CPython3; same code as python_script_empty_list_제거
getItemAtIndex_24 = List.GetItemAtIndex(list=flatten_9, index=python_script_empty_list_제거_4@L2)
code_block_80 = CodeBlock { 1; }
getItemAtIndex_25 = List.GetItemAtIndex(list=valueAtKey_8@L3, index=code_block_80)
dropItems_13 = List.DropItems(list=getItemAtIndex_25@L2, amount=code_block_77)
flatten_10 = List.Flatten(list=dropItems_13)
getItemAtIndex_26 = List.GetItemAtIndex(list=flatten_10, index=python_script_empty_list_제거_4@L2)
code_block_81 = CodeBlock(a=getItemAtIndex_24, b=getItemAtIndex_26) { a+": "+b; }
byKeysValues_5 = DesignScript.Builtin.Dictionary.ByKeysValues(keys=removeItemAtIndex_4, values=code_block_81)

code_block_82 = CodeBlock { "Interior Floor"; "FL"; }

# group: Type 별 WM 추출 - Interior Floor
code_block_83 = CodeBlock(TypeDictionary=byKeysValues, FinishCodeIndex=code_block_49, FinishType=code_block_82.out0, FinishTypeMark=code_block_82.out1)  # same code as code_block_51
valueAtKey_9 = DesignScript.Builtin.Dictionary.ValueAtKey(dictionary=code_block_83.out1, key=code_block_83.out3)
getItemAtIndex_27 = List.GetItemAtIndex(list=valueAtKey_9@L2, index=code_block_83.out2)
contains_7 = String.Contains(str=getItemAtIndex_27, searchFor=code_block_83.out4)
code_block_84 = CodeBlock { true; }
allIndicesOf_13 = List.AllIndicesOf(list=contains_7, item=code_block_84)
getItemAtIndex_28 = List.GetItemAtIndex(list=valueAtKey_9@L3, index=allIndicesOf_13)
code_block_85 = CodeBlock(i=code_block_83.out2) { i; }
dropItems_14 = List.DropItems(list=getItemAtIndex_28@L2, amount=code_block_85)
firstItem_10 = List.FirstItem(list=dropItems_14@L2)
string_from_object_7 = FromObject(object=dropItems_14)
code_block_86 = CodeBlock { "O"; }
allIndicesOf_14 = List.AllIndicesOf(list=string_from_object_7@L2, item=code_block_86)
python_script_empty_list_indices_5 = Python(IN[0]=allIndicesOf_14)  # CPython3; same code as python_script_empty_list_indices
removeItemAtIndex_5 = List.RemoveItemAtIndex(list=firstItem_10, indices=python_script_empty_list_indices_5)
code_block_87 = CodeBlock { 2; }
getItemAtIndex_29 = List.GetItemAtIndex(list=valueAtKey_9@L3, index=code_block_87)
dropItems_15 = List.DropItems(list=getItemAtIndex_29@L2, amount=code_block_85)
flatten_11 = List.Flatten(list=dropItems_15)
python_script_empty_list_제거_5 = Python(IN[0]=allIndicesOf_14)  # CPython3; same code as python_script_empty_list_제거
getItemAtIndex_30 = List.GetItemAtIndex(list=flatten_11, index=python_script_empty_list_제거_5@L2)
code_block_88 = CodeBlock { 1; }
getItemAtIndex_31 = List.GetItemAtIndex(list=valueAtKey_9@L3, index=code_block_88)
dropItems_16 = List.DropItems(list=getItemAtIndex_31@L2, amount=code_block_85)
flatten_12 = List.Flatten(list=dropItems_16)
getItemAtIndex_32 = List.GetItemAtIndex(list=flatten_12, index=python_script_empty_list_제거_5@L2)
code_block_89 = CodeBlock(a=getItemAtIndex_30, b=getItemAtIndex_32) { a+": "+b; }
byKeysValues_6 = DesignScript.Builtin.Dictionary.ByKeysValues(keys=removeItemAtIndex_5, values=code_block_89)

code_block_90 = CodeBlock { "Interior Ceiling"; "CL"; }

# group: Type 별 WM 추출 - Interior Ceiling
code_block_91 = CodeBlock(TypeDictionary=byKeysValues, FinishCodeIndex=code_block_49, FinishType=code_block_90.out0, FinishTypeMark=code_block_90.out1)  # same code as code_block_51
valueAtKey_10 = DesignScript.Builtin.Dictionary.ValueAtKey(dictionary=code_block_91.out1, key=code_block_91.out3)
getItemAtIndex_33 = List.GetItemAtIndex(list=valueAtKey_10@L2, index=code_block_91.out2)
contains_8 = String.Contains(str=getItemAtIndex_33, searchFor=code_block_91.out4)
code_block_92 = CodeBlock { true; }
allIndicesOf_15 = List.AllIndicesOf(list=contains_8, item=code_block_92)
getItemAtIndex_34 = List.GetItemAtIndex(list=valueAtKey_10@L3, index=allIndicesOf_15)
code_block_93 = CodeBlock(i=code_block_91.out2) { i; }
dropItems_17 = List.DropItems(list=getItemAtIndex_34@L2, amount=code_block_93)
firstItem_11 = List.FirstItem(list=dropItems_17@L2)
string_from_object_8 = FromObject(object=dropItems_17)
code_block_94 = CodeBlock { "O"; }
allIndicesOf_16 = List.AllIndicesOf(list=string_from_object_8@L2, item=code_block_94)
python_script_empty_list_indices_6 = Python(IN[0]=allIndicesOf_16)  # CPython3; same code as python_script_empty_list_indices
removeItemAtIndex_6 = List.RemoveItemAtIndex(list=firstItem_11, indices=python_script_empty_list_indices_6)
code_block_95 = CodeBlock { 2; }
getItemAtIndex_35 = List.GetItemAtIndex(list=valueAtKey_10@L3, index=code_block_95)
dropItems_18 = List.DropItems(list=getItemAtIndex_35@L2, amount=code_block_93)
flatten_13 = List.Flatten(list=dropItems_18)
python_script_empty_list_제거_6 = Python(IN[0]=allIndicesOf_16)  # CPython3; same code as python_script_empty_list_제거
getItemAtIndex_36 = List.GetItemAtIndex(list=flatten_13, index=python_script_empty_list_제거_6@L2)
code_block_96 = CodeBlock { 1; }
getItemAtIndex_37 = List.GetItemAtIndex(list=valueAtKey_10@L3, index=code_block_96)
dropItems_19 = List.DropItems(list=getItemAtIndex_37@L2, amount=code_block_93)
flatten_14 = List.Flatten(list=dropItems_19)
getItemAtIndex_38 = List.GetItemAtIndex(list=flatten_14, index=python_script_empty_list_제거_6@L2)
code_block_97 = CodeBlock(a=getItemAtIndex_36, b=getItemAtIndex_38) { a+": "+b; }
byKeysValues_7 = DesignScript.Builtin.Dictionary.ByKeysValues(keys=removeItemAtIndex_6, values=code_block_97)

# group: Merge FinishType Dicts
python_script = Python()  # CPython3; unwired: IN[0]
# ---------- python_script.python (19 lines) ----------
# Load the Python Standard and DesignScript Libraries
import sys
import clr
clr.AddReference('ProtoGeometry')
from Autodesk.DesignScript.Geometry import *
import urllib.request

# The inputs to this node will be stored as a list in the IN variables.
dataEnteringNode = IN
inputURL = "https://raw.githubusercontent.com/HNANmal/mQ/master/Hdynlib/DataStructure/Dictionary/MergeDictionary.py"

# Place your code below this line
req = urllib.request
data = req.urlopen(inputURL)

result = data.read().decode("utf-8")

# Assign your output to the OUT variable.
OUT = result
# ----------------------------------------
join = List.Join(list0=byKeysValues_2, list1=byKeysValues_3, list2=byKeysValues_4, list3=byKeysValues_5, list4=byKeysValues_6, list5=byKeysValues_7)
merge_dictionary = PythonStringNode(script=python_script, IN[0]=join)  # CPython3

# group: Create SettingsDS
settingsDS = Python(IN[0]=code_block_42.out1, IN[1]=merge_dictionary)  # CPython3
# ---------- settingsDS.python (101 lines) ----------
# Load the Python Standard and DesignScript Libraries
import sys
import clr
clr.AddReference('ProtoGeometry')
from Autodesk.DesignScript.Geometry import *

from itertools import chain

# The inputs to this node will be stored as a list in the IN variables.
dataEnteringNode = IN
inputs = IN[0]
wmdict = IN[1]
    

# Place your code below this line
def main():

    def Create_SettingsDS(roomDS, wmdict):
        def find_WM(finishtype, wmdict):
            #result = []
            #result = {}
            if finishtype:
                if finishtype[0] =="":
                    pass
                else:
                    if "WK" in str(finishtype):
                        #result = list(map(lambda x: {"base": wmdict[x]}, finishtype))
                        result = [wmdict[x] for x in finishtype]
                    elif "CL" in str(finishtype):
                        #result = list(map(lambda x: {"ceil": wmdict[x]}, finishtype))
                        result = [wmdict[x] for x in finishtype]
                    elif "IW" in str(finishtype):
                        #result = list(map(lambda x: {"wall": wmdict[x]}, finishtype))
                        result = [wmdict[x] for x in finishtype]
                    elif "FL" in str(finishtype):
                        #result = list(map(lambda x: {"floor": wmdict[x]}, finishtype))
                        result = [wmdict[x] for x in finishtype]
                    elif "RF" in str(finishtype):
                        #result = list(map(lambda x: {"roof": wmdict[x]}, finishtype))
                        result = [wmdict[x] for x in finishtype]
                    elif "EW" in str(finishtype):
                        #result = list(map(lambda x: {"extwall": wmdict[x]}, finishtype))
                        result = [wmdict[x] for x in finishtype]
            else:
                result = []
            return result
            
        name = roomDS["name"]
        roomDS = roomDS
        _baseWM = find_WM(roomDS["basefinish"], wmdict)
        if _baseWM:
            baseWM = _baseWM[0]
        else:
            baseWM = []
        _ceilWM = find_WM(roomDS["ceilfinish"], wmdict)
        if _ceilWM:
            ceilWM = _ceilWM[0]
        else:
            ceilWM = []
        _wallWM = find_WM(roomDS["wallfinish"], wmdict)
        if _wallWM:
            wallWM = _wallWM[0]
        else:
            wallWM = []
        _floorWM = find_WM(roomDS["floorfinish"], wmdict)
        if _floorWM:
            floorWM = _floorWM[0]
        else:
            floorWM = []
        _roofWM = find_WM(roomDS["rooffinish"], wmdict)
        if _roofWM:
            roofWM = _roofWM[0]
        else:
            roofWM = []
        _extwallWM = find_WM(roomDS["extwallfinish"], wmdict)
        if _extwallWM:
            extwallWM = _extwallWM[0]
        else:
            extwallWM = []
        
        result = {
            "name": name,
            "roomDS": roomDS,
            "baseWM": baseWM,
            "ceilWM": ceilWM,
            "wallWM": wallWM,
            "floorWM": floorWM,
            "roofWM": roofWM,
            "extwallWM": extwallWM
        }
        
        return result
        
        
    SettingsDS = Create_SettingsDS(inputs, wmdict)
    
    result = SettingsDS
    return result

# Assign your output to the OUT variable.
OUT = main()
# ----------------------------------------

categories_5 = Categories("OST_Walls")
all_elements_of_category_5 = ElementsOfCategory(Category=categories_5)
gettargetforbase = Python()  # CPython3; unwired: IN[0]
# ---------- gettargetforbase.python (22 lines) ----------
# Load the Python Standard and DesignScript Libraries
import sys
import clr
clr.AddReference('ProtoGeometry')
from Autodesk.DesignScript.Geometry import *

# The inputs to this node will be stored as a list in the IN variables.
dataEnteringNode = IN

# Place your code below this line
def getTargetforBase(SettingsDS, WM):
    targets = []
    
    if "Something" in WM:
        pass
    else:
        targets = SettingsDS["roomDS"]["roomperimeter"]
#    targets = SettingsDS["roomDS"]["roomperimeter"]

    return targets
# Assign your output to the OUT variable.
OUT = getTargetforBase
# ----------------------------------------
gettargetforceil = Python()  # CPython3; unwired: IN[0]
# ---------- gettargetforceil.python (21 lines) ----------
# Load the Python Standard and DesignScript Libraries
import sys
import clr
clr.AddReference('ProtoGeometry')
from Autodesk.DesignScript.Geometry import *

# The inputs to this node will be stored as a list in the IN variables.
dataEnteringNode = IN

# Place your code below this line
def getTargetforCeil(SettingsDS, WM):
    targets = []
    
    if "Something" in WM:
        pass
    else:
        targets = SettingsDS["roomDS"]["roomupperface"]

    return targets
# Assign your output to the OUT variable.
OUT = getTargetforCeil
# ----------------------------------------
gettargetforwall = Python()  # CPython3; unwired: IN[0], IN[1]
# ---------- gettargetforwall.python (42 lines) ----------
# Load the Python Standard and DesignScript Libraries
import sys
import clr
clr.AddReference('ProtoGeometry')
from Autodesk.DesignScript.Geometry import *

# The inputs to this node will be stored as a list in the IN variables.
dataEnteringNode = IN

# Place your code below this line
def getTargetforWall(SettingsDS, WM, masonWall):
    targets = []
    
    if "Plaster" in WM:
        for i in SettingsDS["roomDS"]["roomsideface"]:
            tmp = []
            for j in masonWall:
                if i.DoesIntersect(j.Geometry()[0]):
                    tmp.append(True)
                else:
                    tmp.append(False)
            if any(tmp):
                targets.append(i)
            else:
                pass
    else:
        targets = SettingsDS["roomDS"]["roomsideface"]
#        for i in SettingsDS["roomDS"]["roomsideface"]:
#            tmp = []
#            for j in masonWall:
#                if i.DoesIntersect(j.Geometry()[0]):
#                    tmp.append(False)
#                else:
#                    tmp.append(True)
#            if all(tmp):
#                targets.append(i)
#            else:
#                pass
            
    return targets
# Assign your output to the OUT variable.
OUT = getTargetforWall
# ----------------------------------------
# note: 이 부분은 나중에 함수를 식별해서 적용할 수 있는 str을 키값으로 하는 딕셔너리형태를 반환하는 노드로 수정되어야 한다.
# 그래서 CalculateValueForWM 노드 안에서, 조건식으로 어떤 finish type의 어떤 WM인지에 따라 함수를 조건문으로 골라서 타겟 객체를 형성하고, 면적 혹은 길이 값을 계산하도록 한다.
# + correction factor
gettargetforfloor = Python()  # CPython3; unwired: IN[0]
# ---------- gettargetforfloor.python (21 lines) ----------
# Load the Python Standard and DesignScript Libraries
import sys
import clr
clr.AddReference('ProtoGeometry')
from Autodesk.DesignScript.Geometry import *

# The inputs to this node will be stored as a list in the IN variables.
dataEnteringNode = IN

# Place your code below this line
def getTargetforFloor(SettingsDS, WM):
    targets = []
    
    if "Something" in WM:
        pass
    else:
        targets = SettingsDS["roomDS"]["roombottomface"]

    return targets
# Assign your output to the OUT variable.
OUT = getTargetforFloor
# ----------------------------------------
gettargetforroof = Python()  # CPython3; unwired: IN[0]
# ---------- gettargetforroof.python (21 lines) ----------
# Load the Python Standard and DesignScript Libraries
import sys
import clr
clr.AddReference('ProtoGeometry')
from Autodesk.DesignScript.Geometry import *

# The inputs to this node will be stored as a list in the IN variables.
dataEnteringNode = IN

# Place your code below this line
def getTargetforRoof(SettingsDS, WM):
    targets = []
    
    if "Something" in WM:
        pass
    else:
        targets = SettingsDS["roomDS"]["roomupperface"]

    return targets
# Assign your output to the OUT variable.
OUT = getTargetforRoof
# ----------------------------------------
gettargetforextwall = Python()  # CPython3; unwired: IN[0], IN[1]
# ---------- gettargetforextwall.python (20 lines) ----------
# Load the Python Standard and DesignScript Libraries
import sys
import clr
clr.AddReference('ProtoGeometry')
from Autodesk.DesignScript.Geometry import *

# The inputs to this node will be stored as a list in the IN variables.
dataEnteringNode = IN
input = IN[0]
#refs = IN[1]
#extWall = set(filter(lambda x: "Exterior" in x.Name, refs))
#masonWall = set(filter(lambda x: "Block" in x.Name or "Brick" in x.Name, refs))
#nonMasonWall = set(filter(lambda x: not "Block" in x.Name and not "Brick" in x.Name, refs))

# Place your code below this line
def getTargetforExtWall(SettingsDS, WM, extWall):
    targets = [i for i in extWall if any([True for j in SettingsDS["roomDS"]["disc_line"] if i.Geometry()[0].DoesIntersect(j)])]
    return targets
# Assign your output to the OUT variable.
OUT = getTargetforExtWall
# ----------------------------------------
python_func_list_join = Python(IN[0]=gettargetforbase, IN[1]=gettargetforceil, IN[2]=gettargetforwall, IN[3]=gettargetforfloor, IN[4]=gettargetforroof, IN[5]=gettargetforextwall)  # CPython3
# ---------- python_func_list_join.python (13 lines) ----------
# Load the Python Standard and DesignScript Libraries
import sys
import clr
clr.AddReference('ProtoGeometry')
from Autodesk.DesignScript.Geometry import *

# The inputs to this node will be stored as a list in the IN variables.
dataEnteringNode = IN

# Place your code below this line

# Assign your output to the OUT variable.
OUT = IN
# ----------------------------------------
n30 = Python(IN[0]=settingsDS, IN[1]=all_elements_of_category_5, IN[2]=python_func_list_join)  # "CalculateValueForWM_2021.12.30"; CPython3; frozen
# ---------- n30.python (104 lines) ----------
# Load the Python Standard and DesignScript Libraries
import sys
import clr
clr.AddReference('ProtoGeometry')
from Autodesk.DesignScript.Geometry import *

clr.AddReference("RevitNodes")
import Revit

from Revit.Elements import *

clr.AddReference("DSCoreNodes")
from DSCore import *

from itertools import chain

# The inputs to this node will be stored as a list in the IN variables.
dataEnteringNode = IN
inputs = IN[0]
refs = IN[1]
funcs = IN[2]
getTargetforBase = funcs[0]
getTargetforCeil = funcs[1]
getTargetforWall = funcs[2] ##funtion instance
getTargetforFloor = funcs[3]
getTargetforRoof = funcs[4]
getTargetforExtWall = funcs[5] ##funtion instance

walltype = list(map(lambda x: x.Name, refs))
intWall = list(filter(lambda x: "Interior" in x.Name, refs))
extWall = list(filter(lambda x: "Exterior" in x.Name, refs))
masonWall = list(filter(lambda x: "Block" in x.Name or "Brick" in x.Name, refs))
nonMasonWall = list(filter(lambda x: not "Block" in x.Name and not "Brick" in x.Name, refs))

def CalcualteValueForWM(SettingsDS, funcs):

    name = SettingsDS["roomDS"]["name"]
    roomDS = SettingsDS["roomDS"]
    baseWM = SettingsDS["baseWM"]
    ceilWM = SettingsDS["ceilWM"]
    wallWM = SettingsDS["wallWM"]
    floorWM = SettingsDS["floorWM"]
    roofWM = SettingsDS["roofWM"]
    extwallWM = SettingsDS["extwallWM"]
    
    def unitcalc(SettingsDS, WM, finishtype):
        if finishtype == "base": #roomperimeter
            target = getTargetforBase(SettingsDS, WM)
            calcvalue = sum(list(map(lambda x: x.Length, target)))
            unit = "M"
        elif finishtype == "ceil":
            target = getTargetforCeil(SettingsDS, WM)
            calcvalue = target.Area
            unit = "M2"
        elif finishtype == "wall":
            target = getTargetforWall(SettingsDS, WM, masonWall)
            calcvalue = target.Area
            unit = "M2"
        elif finishtype == "floor":
            target = getTargetforCeil(SettingsDS, WM)
            calcvalue = target.Area
            unit = "M2"
        elif finishtype == "roof":
            target = getTargetforCeil(SettingsDS, WM)
            calcvalue = target.Area
            unit = "M2"
        elif finishtype == "extwall":
            target = getTargetforCeil(SettingsDS, WM, masonWall)
            calcvalue = target.GetParameterValueByName("Area")
            unit = "M2"
        
        result = []
        result.append(SettingsDS["name"])
        result.append(SettingsDS["roomDS"]["roomelem"].GetParameterValueByName("Department"))
        result.append(WM.split(': ')[0]) ##WM code
        result.append(WM.split(': ')[1]) ##WM description
        result.append(calcvalue)
        result.append(unit)
        
        return result
    Output = []
    baseout = list(map(lambda x: unitcalc(SettingsDS, x, "base"), baseWM))
    Output.append(baseout)
#    ceilout = list(map(lambda x: unitcalc(SettingsDS, x, "ceil"), ceilWM))
#    Output.append(ceilout)
#    wallout = list(map(lambda x: unitcalc(SettingsDS, x, "wall"), wallWM))
#    Output.append(wallout)
#    floorout = list(map(lambda x: unitcalc(SettingsDS, x, "floor"), floorWM))
#    Output.append(floorout)
#    roofout = list(map(lambda x: unitcalc(SettingsDS, x, "roof"), roofWM))
#    Output.append(roofout)
#    extwallout = list(map(lambda x: unitcalc(SettingsDS, x, "extwall"), extwallWM))
#    Output.append(extwallout)
    
    return Output
# Place your code below this line

    
calcualteValueForWM = CalcualteValueForWM(inputs, funcs)

result = calcualteValueForWM

# Assign your output to the OUT variable.
OUT = result
# ----------------------------------------
categories_6 = Categories("OST_Walls")
all_elements_of_category_6 = ElementsOfCategory(Category=categories_6)
categories_7 = Categories("OST_Floors")
all_elements_of_category_7 = ElementsOfCategory(Category=categories_7)
target의_구조_판별부_작업중 = Python(IN[1]=all_elements_of_category_6, IN[2]=all_elements_of_category_7)  # CPython3; frozen; unwired: IN[0]; starter script, not edited (OUT = 0)

# group: Sample Test for Function Import from Other Node
func1 = Python()  # CPython3; unwired: IN[0]
# ---------- func1.python (14 lines) ----------
# Load the Python Standard and DesignScript Libraries
import sys
import clr
clr.AddReference('ProtoGeometry')
from Autodesk.DesignScript.Geometry import *

# The inputs to this node will be stored as a list in the IN variables.
dataEnteringNode = IN

# Place your code below this line
def func1(a):
    return a*a
# Assign your output to the OUT variable.
OUT = func1
# ----------------------------------------
func2 = Python()  # CPython3; unwired: IN[0]
# ---------- func2.python (14 lines) ----------
# Load the Python Standard and DesignScript Libraries
import sys
import clr
clr.AddReference('ProtoGeometry')
from Autodesk.DesignScript.Geometry import *

# The inputs to this node will be stored as a list in the IN variables.
dataEnteringNode = IN

# Place your code below this line
def func2(a):
    return 10*a
# Assign your output to the OUT variable.
OUT = func2
# ----------------------------------------
func3 = Python()  # CPython3; unwired: IN[0]
# ---------- func3.python (14 lines) ----------
# Load the Python Standard and DesignScript Libraries
import sys
import clr
clr.AddReference('ProtoGeometry')
from Autodesk.DesignScript.Geometry import *

# The inputs to this node will be stored as a list in the IN variables.
dataEnteringNode = IN

# Place your code below this line
def func3(a):
    return [a]
# Assign your output to the OUT variable.
OUT = func3
# ----------------------------------------
python_func_list_join_2 = Python(IN[0]=func1, IN[1]=func2, IN[2]=func3)  # CPython3; same code as python_func_list_join
code_block_98 = CodeBlock { 2; }
python_script_2 = Python(IN[0]=python_func_list_join_2, IN[1]=code_block_98)  # CPython3
# ---------- python_script_2.python (18 lines) ----------
# Load the Python Standard and DesignScript Libraries
import sys
import clr
clr.AddReference('ProtoGeometry')
from Autodesk.DesignScript.Geometry import *

# The inputs to this node will be stored as a list in the IN variables.
dataEnteringNode = IN
func1 = IN[0][0]
func2 = IN[0][1]
func3 = IN[0][2]

arg = IN[1]
# Place your code below this line
result = [func1(arg), func2(arg), func3(arg)]

# Assign your output to the OUT variable.
OUT = result
# ----------------------------------------

code_block_99 = CodeBlock { i["wallWMTarget"]; }  # frozen; unwired: i
code_block_100 = CodeBlock(i=code_block_99) { i[1]; }
code_block_101 = CodeBlock(i=code_block_99) { i[0]; }
code_block_102 = CodeBlock { i["extwallWMTarget"]; }  # frozen; unwired: i
geometry = Element.Geometry(element=code_block_102)
n29 = Python(IN[0]=settingsDS, IN[1]=all_elements_of_category_5, IN[2]=python_func_list_join)  # "CalculateValueForWM_2021.12.29"; CPython3; frozen
# ---------- n29.python (100 lines) ----------
# Load the Python Standard and DesignScript Libraries
import sys
import clr
clr.AddReference('ProtoGeometry')
from Autodesk.DesignScript.Geometry import *

from itertools import chain

# The inputs to this node will be stored as a list in the IN variables.
dataEnteringNode = IN
inputs = IN[0]
refs = IN[1]
funcs = IN[2]
getTargetforWall = funcs[0]##funtion instance

walltype = set(map(lambda x: x.Name, refs))
intWall = list(filter(lambda x: "Interior" in x.Name, refs))
extWall = list(filter(lambda x: "Exterior" in x.Name, refs))
masonWall = list(filter(lambda x: "Block" in x.Name or "Brick" in x.Name, refs))
nonMasonWall = list(filter(lambda x: not "Block" in x.Name and not "Brick" in x.Name, refs))

def TargetGeoDS(SettingsDS, funcs):
    def getTargetGeoByType(SettingsDS, calctype):
        targetGeo = None
        if calctype:
            typemark = calctype.Keys
            if "base" in typemark:
                targetGeo = PolyCurve.ByJoinedCurves(SettingsDS["roomDS"]["roomperimeter"])
            elif "ceil" in typemark:
                targetGeo = SettingsDS["roomDS"]["roomupperface"]
            elif "wall" in typemark:
                targetGeo = SettingsDS["roomDS"]["roomsideface"]
            elif "floor" in typemark:
                targetGeo = SettingsDS["roomDS"]["roombottomface"]
            elif "roof" in typemark:
                targetGeo = SettingsDS["roomDS"]["roomupperface"]
#            elif "extwall" in typemark:
#                targetGeo = SettingsDS["roomDS"]["surfacedict"]
            else:
                targetGeo = []
        else:
            pass
        return targetGeo
    
    name = SettingsDS["roomDS"]["name"]
    roomDS = SettingsDS["roomDS"]
    baseWM = SettingsDS["baseWM"]
    baseWMTarget = getTargetGeoByType(SettingsDS, baseWM)###함수 분리 형태로 수정해야함
    ceilWM = SettingsDS["ceilWM"]
    ceilWMTarget = getTargetGeoByType(SettingsDS, ceilWM)
    wallWM = SettingsDS["wallWM"]
    targetSrfs = getTargetforWall(SettingsDS, masonWall)
    wallWMTarget = targetSrfs
    floorWM = SettingsDS["floorWM"]
    floorWMTarget = getTargetGeoByType(SettingsDS, floorWM)
    roofWM = SettingsDS["roofWM"]
    roofWMTarget = getTargetGeoByType(SettingsDS, roofWM)
    extwallWM = SettingsDS["extwallWM"]
    disc_line = roomDS["disc_line"]
    targetExtWall = []###여기도 함수참조 형식을 바꾸기
    for i in extWall:
        tmp = []
        for j in disc_line:
            if i.Geometry()[0].DoesIntersect(j):
                tmp.append(True)
            else:
                tmp.append(False)
        if any(tmp):
            targetExtWall.append(i)
        else:
            pass

    extwallWMTarget = targetExtWall
    
    result = {
        "name": name,
        "roomDS": roomDS,
        "baseWM": baseWM,
        "baseWMTarget": baseWMTarget,
        "ceilWM": ceilWM,
        "ceilWMTarget": ceilWMTarget,
        "wallWM": wallWM,
        "wallWMTarget": wallWMTarget,
        "floorWM": floorWM,
        "floorWMTarget": floorWMTarget,
        "roofWM": roofWM,
        "roofWMTarget": roofWMTarget,
        "extwallWM": extwallWM,
        "extwallWMTarget": extwallWMTarget,
    }
    return result
# Place your code below this line

    
targetGeoDS = TargetGeoDS(inputs, funcs)

result = targetGeoDS

# Assign your output to the OUT variable.
OUT = result
# ----------------------------------------
byJoinedCurves = PolyCurve.ByJoinedCurves()  # unwired: curves
count_17 = DesignScript.Builtin.Dictionary.Count(dictionary=settingsDS)
python_script_e딕셔너리_오류_테스트 = Python(IN[0]=settingsDS)  # CPython3; frozen
# ---------- python_script_e딕셔너리_오류_테스트.python (13 lines) ----------
# Load the Python Standard and DesignScript Libraries
import sys
import clr
clr.AddReference('ProtoGeometry')
from Autodesk.DesignScript.Geometry import *

# The inputs to this node will be stored as a list in the IN variables.
dataEnteringNode = IN
SettingsDS = IN[0]
# Place your code below this line
baseWM = SettingsDS["baseWM"].Values
# Assign your output to the OUT variable.
OUT = baseWM
# ----------------------------------------
calculateValueForWM = Python(IN[0]=settingsDS, IN[1]=all_elements_of_category_5, IN[2]=python_func_list_join)  # CPython3
# ---------- calculateValueForWM.python (100 lines) ----------
# Load the Python Standard and DesignScript Libraries
import sys
import clr
clr.AddReference('ProtoGeometry')
from Autodesk.DesignScript.Geometry import *

clr.AddReference("RevitNodes")
import Revit

from Revit.Elements import *

clr.AddReference("DSCoreNodes")
from DSCore import *

from itertools import chain

# The inputs to this node will be stored as a list in the IN variables.
dataEnteringNode = IN
inputs = IN[0]
refs = IN[1]
funcs = IN[2]
getTargetforBase = funcs[0]
getTargetforCeil = funcs[1]
getTargetforWall = funcs[2] ##funtion instance
getTargetforFloor = funcs[3]
getTargetforRoof = funcs[4]
getTargetforExtWall = funcs[5] ##funtion instance

walltype = set(map(lambda x: x.Name, refs))
intWall = set(filter(lambda x: "Interior" in x.Name, refs))
extWall = set(filter(lambda x: "Exterior" in x.Name, refs))
masonWall = set(filter(lambda x: "Block" in x.Name or "Brick" in x.Name, refs))
nonMasonWall = set(filter(lambda x: not "Block" in x.Name and not "Brick" in x.Name, refs))

def checkValid(value):
    try:
        return value
    except:
        pass

def CalcualteValueForWM(SettingsDS, funcs):

    name = SettingsDS["roomDS"]["name"]
    roomDS = SettingsDS["roomDS"]
    baseWM = SettingsDS["baseWM"]
    ceilWM = SettingsDS["ceilWM"]
    wallWM = SettingsDS["wallWM"]
    floorWM = SettingsDS["floorWM"]
    roofWM = SettingsDS["roofWM"]
    extwallWM = SettingsDS["extwallWM"]
    
    def unitcalc(SettingsDS, WM, finishtype):
        if finishtype == "base": #roomperimeter
            target = getTargetforBase(SettingsDS, WM)
            calcvalue = round(sum(list(map(lambda x: x.Length, target)))/1000,2)
            unit = "M"
        elif finishtype == "ceil":
            target = getTargetforCeil(SettingsDS, WM)
            calcvalue = round(sum(list(map(lambda x: x.Area, target)))/1000000,2)
            unit = "M2"
        elif finishtype == "wall":
            target = getTargetforWall(SettingsDS, WM, masonWall)
            calcvalue = round(sum(list(map(lambda x: x.Area, target)))/1000000,2)
            unit = "M2"
        elif finishtype == "floor":
            target = getTargetforCeil(SettingsDS, WM)
            calcvalue = round(sum(list(map(lambda x: x.Area, target)))/1000000,2)
            unit = "M2"
        elif finishtype == "roof":
            target = getTargetforCeil(SettingsDS, WM)
            calcvalue = round(sum(list(map(lambda x: x.Area, target)))/1000000,2)
            unit = "M2"
        elif finishtype == "extwall":
            target = getTargetforExtWall(SettingsDS, WM, extWall)
            calcvalue = sum(list(map(lambda x: x.GetParameterValueByName("Area"), target)))
            unit = "M2"
            
        result = []
        result.append(SettingsDS["name"])
        result.append(SettingsDS["roomDS"]["roomelem"].GetParameterValueByName("Department"))
#        result.append(WM)
        result.append(WM.split(': ')[0]) ##WM code
        result.append(WM.split(': ')[1]) ##WM description
        result.append(calcvalue)
        result.append(unit)
        return result
    value_base = list(map(lambda x: checkValid(unitcalc(SettingsDS, x, "base")), baseWM))
    value_ceil = list(map(lambda x: checkValid(unitcalc(SettingsDS, x, "ceil")), ceilWM))
    value_wall = list(map(lambda x: checkValid(unitcalc(SettingsDS, x, "wall")), wallWM))
    value_floor = list(map(lambda x: checkValid(unitcalc(SettingsDS, x, "floor")), floorWM))
    value_roof = checkValid(list(map(lambda x: checkValid(unitcalc(SettingsDS, x, "roof")), roofWM)))
    value_extwall = list(map(lambda x: checkValid(unitcalc(SettingsDS, x, "extwall")), extwallWM))
    
    
    return value_base + value_ceil + value_wall + value_floor + value_roof + value_extwall


result = CalcualteValueForWM(inputs, funcs)
# Assign your output to the OUT variable.
OUT = result
# ----------------------------------------
valueAtKey_11 = DesignScript.Builtin.Dictionary.ValueAtKey()  # unwired: dictionary, key
