# Dynamo graph 3_Modelization(1222).dyn (Dynamo 2.10.1.3976)
# packages: GenerativeDesign 1.7.3.0, GenerativeDesign 1.10.10.0

# group: All Grids Elements
categories = Categories("OST_Grids")
all_elements_of_category = ElementsOfCategory(Category=categories)

# group: Create GridInfo Instances
python_script = Python(IN[0]=all_elements_of_category)  # "Python Script@createGridIntersectPointsDict"; CPython3
# ---------- python_script.python (84 lines) ----------
# Load the Python Standard and DesignScript Libraries
import sys
import clr
clr.AddReference('ProtoGeometry')
from Autodesk.DesignScript.Geometry import *

clr.AddReference('RevitAPI')
from Autodesk.Revit.DB import *

clr.AddReference("RevitServices")
import RevitServices
from RevitServices.Persistence import DocumentManager
from RevitServices.Transactions import TransactionManager

clr.AddReference("RevitNodes")
import Revit

doc = DocumentManager.Instance.CurrentDBDocument

#crv = Revit.GeometryConversion.RevitToProtoCurve.ToProtoType( crv, true )

# The inputs to this node will be stored as a list in the IN variables.
dataEnteringNode = IN

#alllevels =  FilteredElementCollector(doc).OfClass(Level).WhereElementIsNotElementType().ToElements()

#allgrids = FilteredElementCollector(doc).OfClass(Grid).WhereElementIsNotElementType().ToElements()

allgrids = IN[0]

class GridInfo():
    def __init__(self, grid):
        def findDirection(gridVector):
            if gridVector.IsParallel(Vector.XAxis()):
                return "X_axis"
            else:
                return "Y_axis"
        gridName = grid.Name
        self.gridName = gridName
        gridCrv = grid.Curve
        self.gridCrv = gridCrv
        gridVector = gridCrv.Direction.Normalized()
        self.gridVector = gridVector
        direction = findDirection(gridVector)
        self.direction = direction

# Place your code below this line

def createCrossPointsDict(allgrids):
    all_gridInfo = list(map(lambda i: GridInfo(i), allgrids))
    xgridInfo = list(filter(lambda i: i.direction == "X_axis", all_gridInfo))
    ygridInfo = list(filter(lambda i: i.direction == "Y_axis", all_gridInfo))
    def getPtsDict(xgridInfo, ygridInfo):
        _keys = []
        _values = []
        _result = {}
        for i in xgridInfo:
            for j in ygridInfo:
                loc_mark = '-'.join([i.gridName, j.gridName])
                loc_pts = i.gridCrv.Intersect(j.gridCrv)
                _result[loc_mark] = loc_pts
                _keys.append(loc_mark)
                _values.append(loc_pts)
        return [_keys, list(zip(*_values)), _result]

    result = getPtsDict(xgridInfo, ygridInfo)
    return result

def splitGridCurve(gridinfo, pointsDict):
    originCrv = gridinfo.gridCrv
    pts = pointsDict[1][0]
    targetpts = list(filter(lambda i: i.DoesIntersect(originCrv), pts))
    splitCrvs = originCrv.SplitByPoints(targetpts)
    return splitCrvs


pointsDict = createCrossPointsDict(allgrids)
all_gridInfo = list(map(lambda i: GridInfo(i), allgrids))
splitCrvs = list(map(lambda i: splitGridCurve(i, pointsDict), all_gridInfo))


result = [pointsDict[0], pointsDict[1], pointsDict[2], splitCrvs]
# Assign your output to the OUT variable.
OUT = result
# ----------------------------------------
code_block = CodeBlock(i=python_script) { i[0]; i[1]; i[2]; i[3]; }
code_block_2 = CodeBlock(pointsDictKeys=code_block.out0, pointsDictValues=code_block.out1, pointsDict=code_block.out2, splitCrvs=code_block.out3) { pointsDictKeys; pointsDictValues; pointsDict; splitCrvs; }

# group: All Splitted Curve
splitted_curve = CodeBlock(i=code_block_2.splitCrvs) { i[1]; }
flatten = List.Flatten(list=splitted_curve)

# group: All Room Elements
categories_2 = Categories("OST_Rooms")
all_elements_of_category_2 = ElementsOfCategory(Category=categories_2)

# group: Create RoomInfo Instances
string_from_web = Python()  # CPython3; unwired: IN[0]
# ---------- string_from_web.python (19 lines) ----------
# Load the Python Standard and DesignScript Libraries
import sys
import clr
clr.AddReference('ProtoGeometry')
from Autodesk.DesignScript.Geometry import *
import urllib.request

# The inputs to this node will be stored as a list in the IN variables.
dataEnteringNode = IN
inputURL = "https://raw.githubusercontent.com/HNANmal/mQ/master/Hdynlib/DataStructure/Custom/Rooms/CreateRoomInfoInstance.py"

# Place your code below this line
req = urllib.request
data = req.urlopen(inputURL)

result = data.read().decode("utf-8")

# Assign your output to the OUT variable.
OUT = result
# ----------------------------------------
string_from_web_2 = Python()  # CPython3; unwired: IN[0]
# ---------- string_from_web_2.python (19 lines) ----------
# Load the Python Standard and DesignScript Libraries
import sys
import clr
clr.AddReference('ProtoGeometry')
from Autodesk.DesignScript.Geometry import *
import urllib.request

# The inputs to this node will be stored as a list in the IN variables.
dataEnteringNode = IN
inputURL = "https://raw.githubusercontent.com/HNANmal/mQ/master/Hdynlib/DataStructure/Custom/Rooms/RoomInfoClass.py"

# Place your code below this line
req = urllib.request
data = req.urlopen(inputURL)

result = data.read().decode("utf-8")

# Assign your output to the OUT variable.
OUT = result
# ----------------------------------------
roominfoclass = PythonStringNode(script=string_from_web_2, IN[1]=all_elements_of_category_2)  # CPython3; unwired: IN[0]
createroominfoinstance = PythonStringNode(script=string_from_web, IN[1]=all_elements_of_category_2, IN[2]=roominfoclass)  # CPython3; unwired: IN[0]
code_block_3 = CodeBlock(i=createroominfoinstance) { i[0]; i[1]; }
roomInfoInstances = CodeBlock(result=code_block_3.out1) { result; }

code_block_4 = CodeBlock(i=roomInfoInstances) { i; }

# group: 건물 바운더리 생성(GF 기준)
python_script_2 = Python(IN[0]=code_block_4)  # CPython3
# ---------- python_script_2.python (16 lines) ----------
# Load the Python Standard and DesignScript Libraries
import sys
import clr
clr.AddReference('ProtoGeometry')
from Autodesk.DesignScript.Geometry import *

# The inputs to this node will be stored as a list in the IN variables.
dataEnteringNode = IN

inputs = IN[0]

# Place your code below this line

result = list(map(lambda i: i.roombottomface, filter(lambda j: j.level == "GF", inputs)))
# Assign your output to the OUT variable.
OUT = result
# ----------------------------------------

remember = Data.Remember(python_script_2)

# group (continued): 건물 바운더리 생성(GF 기준)
flatten_2 = List.Flatten(list=remember)
byJoinedSurfaces = PolySurface.ByJoinedSurfaces(surfaces=flatten_2)
perimeterCurves = Surface.PerimeterCurves(surface=byJoinedSurfaces)
byJoinedCurves = PolyCurve.ByJoinedCurves(curves=perimeterCurves)

# group: 외곽선 500 오프셋
code_block_5 = CodeBlock { 500; }
offset = Curve.Offset(curve=byJoinedCurves, distance=code_block_5)

# group: 건물 테두리 내부 Splitted Curve 추출
levels = Levels("GF")
elevation = Level.Elevation(level=levels)
translate = Geometry.Translate(geometry=flatten, zTranslation=elevation)
doesIntersect = Geometry.DoesIntersect(geometry=translate, other=offset)
filterByBoolMask = List.FilterByBoolMask(list=translate, mask=doesIntersect)
flatten_3 = List.Flatten(list=filterByBoolMask.out)

# group: All Levels Elements
categories_3 = Categories("OST_Levels")
all_elements_of_category_3 = ElementsOfCategory(Category=categories_3)

# group: 지하층 제외 전체 레벨
string_from_web_3 = Python()  # CPython3; unwired: IN[0]
# ---------- string_from_web_3.python (19 lines) ----------
# Load the Python Standard and DesignScript Libraries
import sys
import clr
clr.AddReference('ProtoGeometry')
from Autodesk.DesignScript.Geometry import *
import urllib.request

# The inputs to this node will be stored as a list in the IN variables.
dataEnteringNode = IN
inputURL = "https://raw.githubusercontent.com/HNANmal/mQ/master/Hdynlib/Revit/Elements/Filtering/FilterElementsExceptTarget.py"

# Place your code below this line
req = urllib.request
data = req.urlopen(inputURL)

result = data.read().decode("utf-8")

# Assign your output to the OUT variable.
OUT = result
# ----------------------------------------
boolean = BoolSelector(false)
code_block_6 = CodeBlock { "B"; }
filterelementsexcepttarget = PythonStringNode(script=string_from_web_3, IN[0]=all_elements_of_category_3, IN[1]=boolean, IN[2]=code_block_6)  # CPython3

# group: GF 제외 전체 레벨
string_from_web_4 = Python()  # CPython3; unwired: IN[0]; same code as string_from_web_3
boolean_2 = BoolSelector(false)
code_block_7 = CodeBlock { "G"; }
filterelementsexcepttarget_2 = PythonStringNode(script=string_from_web_4, IN[0]=filterelementsexcepttarget, IN[1]=boolean_2, IN[2]=code_block_7)  # CPython3

# group: 층별로 Splitted Curve 복사
elevation_2 = Level.Elevation(level=filterelementsexcepttarget_2)
translate_2 = Geometry.Translate(geometry=flatten_3, zTranslation=elevation_2, lacing=CrossProduct)
transpose = List.Transpose(lists=translate_2)

# group: 빔거더 배치 구간
family_types = FamilyTypes("Concrete-Rectangular-Beam:BM111_400x500_RG1")
beamByCurve = StructuralFraming.BeamByCurve(curve=transpose, level=filterelementsexcepttarget_2, structuralFramingType=family_types, lacing=CrossProduct)  # frozen
levels_2 = Levels("GF")

code_block_8 = CodeBlock(i=code_block_2.pointsDictValues) { i; }
code_block_9 = CodeBlock(i=code_block_8) { i; }

# group: 기둥 배치 구간
structural_column_types = StructuralColumnTypes("CL111_500x500")
code_block_10 = CodeBlock(input=code_block_9) { input; }
flatten_4 = List.Flatten(list=code_block_10)
byPointAndLevel = FamilyInstance.ByPointAndLevel(familyType=structural_column_types, point=flatten_4, level=filterelementsexcepttarget, lacing=CrossProduct)  # frozen

# group: 패데스탈 배치구간
structural_column_types_2 = StructuralColumnTypes("CL111_500x500")
code_block_11 = CodeBlock(input=code_block_9) { input; }
flatten_5 = List.Flatten(list=code_block_11)
categories_4 = Categories("OST_Levels")
all_elements_of_category_4 = ElementsOfCategory(Category=categories_4)
code_block_12 = CodeBlock(i=all_elements_of_category_4) { i[1]; }
byPointAndLevel_2 = FamilyInstance.ByPointAndLevel(familyType=structural_column_types_2, point=flatten_5, level=code_block_12)  # frozen

code_block_13 = CodeBlock()  # //RevitMemberCreaterClass
watch = Watch(code_block_3.out0)

# group: 기초 배치구간
family_types_2 = FamilyTypes("FT112-Footing-Rectangular:FT112_2400x2400x500")
code_block_14 = CodeBlock(input=code_block_9) { input; }
flatten_6 = List.Flatten(list=code_block_14)
categories_5 = Categories("OST_Levels")
all_elements_of_category_5 = ElementsOfCategory(Category=categories_5)
code_block_15 = CodeBlock(i=all_elements_of_category_5) { i[1]; }
byPointAndLevel_3 = FamilyInstance.ByPointAndLevel(familyType=family_types_2, point=flatten_6, level=code_block_15)  # frozen

# group: 외곽선 -500 오프셋
code_block_16 = CodeBlock { -500; }
offset_2 = Curve.Offset(curve=byJoinedCurves, distance=code_block_16)
byPatch = Surface.ByPatch(closedCurve=offset_2)

# group: 건물 외곽 Splitted Curve 추출(TG 용)
doesIntersect_2 = Geometry.DoesIntersect(geometry=flatten_3, other=byPatch)
filterByBoolMask_2 = List.FilterByBoolMask(list=flatten_3, mask=doesIntersect_2)

# group: 해당 층으로 Splitted Curve 복사
levels_3 = Levels("GF")
elevation_3 = Level.Elevation(level=levels_3)
translate_3 = Geometry.Translate(geometry=filterByBoolMask_2.out, zTranslation=elevation_3, lacing=CrossProduct)
transpose_2 = List.Transpose(lists=translate_3)

# group: 타이거더 배치 구간
family_types_3 = FamilyTypes("Concrete-Rectangular-Beam:BM111_400x500_RG1")
beamByCurve_2 = StructuralFraming.BeamByCurve(curve=transpose_2, level=levels_3, structuralFramingType=family_types_3, lacing=CrossProduct)  # frozen

remember_2 = Data.Remember()  # unwired: arg0
flatten_7 = List.Flatten(list=remember_2)
code_block_17 = CodeBlock { 0.5; }
pointAtParameter = Surface.PointAtParameter(surface=flatten_7, u=code_block_17, v=code_block_17)
Z = Point.Z(point=pointAtParameter)
round = Math.Round(number=Z)
uniqueItems = List.UniqueItems(list=round)
eq = uniqueItems == Z  # lacing=CrossProduct
filterByBoolMask_3 = List.FilterByBoolMask(list=flatten_7, mask=eq@L2)
watch_2 = Watch(filterByBoolMask_3.in)
perimeterCurves_2 = Surface.PerimeterCurves(surface=watch_2)
byJoinedCurves_2 = PolyCurve.ByJoinedCurves(curves=perimeterCurves_2)
string_from_web_5 = Python()  # CPython3; unwired: IN[0]; same code as string_from_web_3
boolean_3 = BoolSelector(false)
code_block_18 = CodeBlock { "B"; }
filterelementsexcepttarget_3 = PythonStringNode(script=string_from_web_5, IN[0]=all_elements_of_category_3, IN[1]=boolean_3, IN[2]=code_block_18)  # CPython3

# group: Floor 배치 구간
floor_types = FloorTypes("CFS11_Slab RC_T150")
byOutlineTypeAndLevel = Floor.ByOutlineTypeAndLevel(outline=byJoinedCurves_2, floorType=floor_types, level=filterelementsexcepttarget_3)  # frozen

code_block_19 = CodeBlock(i=roomInfoInstances) { i; }
python_script_3 = Python(IN[0]=code_block_19)  # CPython3
# ---------- python_script_3.python (16 lines) ----------
# Load the Python Standard and DesignScript Libraries
import sys
import clr
clr.AddReference('ProtoGeometry')
from Autodesk.DesignScript.Geometry import *

# The inputs to this node will be stored as a list in the IN variables.
dataEnteringNode = IN

inputs = IN[0]

# Place your code below this line

result = list(map(lambda i: i.roombottomface, inputs))
# Assign your output to the OUT variable.
OUT = result
# ----------------------------------------
code_block_20 = CodeBlock(i=roomInfoInstances) { i; }
python_script_4 = Python(IN[0]=code_block_20)  # CPython3
# ---------- python_script_4.python (43 lines) ----------
# Load the Python Standard and DesignScript Libraries
import sys
import clr
clr.AddReference('ProtoGeometry')
from Autodesk.DesignScript.Geometry import *

# The inputs to this node will be stored as a list in the IN variables.
dataEnteringNode = IN

inputs = IN[0]

# Place your code below this line
def rooffinbln(x):
    if len(x.rooffinish)==0:
        return False
    else:
        for i in x.rooffinish:
            if "RF" in i:
                return True
            else:
                return False

def ceilfinbln(x):
    if len(x.ceilfinish)==0:
        return False
    else:
        for i in x.ceilfinish:
            if "CL" in i:
                return True
            else:
                return False

#result = list(filter(lambda i: "RF" in i.rooffinish, inputs))
#_targets = list(
#            filter(lambda i: rooffinbln(i),
#                filter(lambda j: ceilfinbln(j), inputs))
#                )
_targets = list(filter(lambda i: i.level == "4F", inputs))
targets = list(filter(lambda i: rooffinbln(i), _targets))
result1 = list(map(lambda i: i.roombottomface, targets))
result2 = list(map(lambda i: i.level, targets))
# Assign your output to the OUT variable.
OUT = [result1, result2]
# ----------------------------------------
remember_3 = Data.Remember(python_script_4)
code_block_21 = CodeBlock(i=remember_3) { List.Flatten(i[0]); }
ZAxis = Vector.ZAxis()
all_levels = CodeBlock(i=all_elements_of_category_3) { i; }
elevation_4 = Level.Elevation()  # unwired: level
sortByFunction = List.SortByFunction(list=all_levels, sortFunction=elevation_4)
string_from_object = FromObject(object=sortByFunction)
code_block_22 = CodeBlock(i=remember_3) { i[1]; }
uniqueItems_2 = List.UniqueItems(list=code_block_22)
firstItem = List.FirstItem(list=uniqueItems_2)
contains = String.Contains(str=string_from_object, searchFor=firstItem)
code_block_23 = CodeBlock { true; }
allIndicesOf = List.AllIndicesOf(list=contains, item=code_block_23)
code_block_24 = CodeBlock(i=allIndicesOf) { i+1; }
getItemAtIndex = List.GetItemAtIndex(list=sortByFunction, index=code_block_24)
elevation_5 = Level.Elevation(level=getItemAtIndex)
getItemAtIndex_2 = List.GetItemAtIndex(list=sortByFunction, index=allIndicesOf)
elevation_6 = Level.Elevation(level=getItemAtIndex_2)
sub = elevation_5 - elevation_6
code_block_25 = CodeBlock(i=sub) { i[0]; }
translate_4 = Geometry.Translate(geometry=code_block_21, direction=ZAxis, distance=code_block_25)
code_block_26 = CodeBlock(i=roomInfoInstances) { i; }
python_script_5 = Python(IN[0]=code_block_26)  # CPython3
# ---------- python_script_5.python (16 lines) ----------
# Load the Python Standard and DesignScript Libraries
import sys
import clr
clr.AddReference('ProtoGeometry')
from Autodesk.DesignScript.Geometry import *

# The inputs to this node will be stored as a list in the IN variables.
dataEnteringNode = IN

inputs = IN[0]

# Place your code below this line
target =  list(filter(lambda i: i.level == "PF", inputs))
result = list(map(lambda i: i.roomupperface, target))
# Assign your output to the OUT variable.
OUT = result
# ----------------------------------------
remember_4 = Data.Remember(python_script_5)
flatten_8 = List.Flatten(list=remember_4)
join = List.Join(list0=translate_4, list1=flatten_8)
perimeterCurves_3 = Surface.PerimeterCurves(surface=join)
byJoinedCurves_3 = PolyCurve.ByJoinedCurves(curves=perimeterCurves_3)
levels_4 = Levels("PF")

# group: Roof 배치 구간
floor_types_2 = FloorTypes("CFS11_Slab RC_T150")
byOutlineTypeAndLevel_2 = Floor.ByOutlineTypeAndLevel(outline=byJoinedCurves_3, floorType=floor_types_2, level=levels_4)  # frozen

code_block_27 = CodeBlock(i=roomInfoInstances) { i; }
python_script_6 = Python()  # CPython3; unwired: IN[0]
# ---------- python_script_6.python (37 lines) ----------
# Load the Python Standard and DesignScript Libraries
import sys
import clr
clr.AddReference('ProtoGeometry')
from Autodesk.DesignScript.Geometry import *

# The inputs to this node will be stored as a list in the IN variables.
dataEnteringNode = IN

inputs = IN[0]

# Place your code below this line
def rooffinbln(x):
    if len(x.rooffinish)==0:
        return False
    else:
        for i in x.rooffinish:
            if "RF" in i:
                return True
            else:
                return False

def ceilfinbln(x):
    if len(x.ceilfinish)==0:
        return False
    else:
        for i in x.ceilfinish:
            if "CL" in i:
                return True
            else:
                return False


result = list(map(lambda i: i.surfacedict, inputs))

# Assign your output to the OUT variable.
OUT = result
# ----------------------------------------
code_block_28 = CodeBlock(i=python_script_6) { i["Int Surfaces"]; }
remember_5 = Data.Remember()  # unwired: arg0
flatten_9 = List.Flatten(list=remember_5)
python_script_7 = Python(IN[0]=flatten_9)  # CPython3
# ---------- python_script_7.python (30 lines) ----------
# Load the Python Standard and DesignScript Libraries
import sys
import clr
clr.AddReference('ProtoGeometry')
from Autodesk.DesignScript.Geometry import *

# The inputs to this node will be stored as a list in the IN variables.
dataEnteringNode = IN

inputs = IN[0]
# Place your code below this line
#def findunderline(lines):
#    tmp = list(map(i.StartPoint

target1 = list(map(lambda i: i.PerimeterCurves(), inputs))

result = []
for i in target1:
    tmp1 = list(filter(lambda x: x.Direction.Z == 0, i))
    tmp2 = []
    if tmp1[0].StartPoint.Z < tmp1[1].StartPoint.Z:
        tmp2.append(tmp1[0])
    else:
        tmp2.append(tmp1[1])
    result.append(tmp2)
        

#result = list(filter(lambda i: i.StartPoint == 
# Assign your output to the OUT variable.
OUT = result
# ----------------------------------------
flatten_10 = List.Flatten(list=python_script_7)
byCurveAndHeight = Wall.ByCurveAndHeight(curve=flatten_10)  # unwired: height, level, wallType
perimeterCurves_4 = Surface.PerimeterCurves()  # unwired: surface
direction = Line.Direction()  # unwired: line
startPoint = Curve.StartPoint()  # unwired: curve
string_from_object_2 = FromObject(object=flatten_10)
uniqueItems_3 = List.UniqueItems(list=string_from_object_2)
python_script_8 = Python(IN[0]=all_elements_of_category)  # "Python Script@createGridIntersectPointsDict"; CPython3
# ---------- python_script_8.python (78 lines) ----------
# Load the Python Standard and DesignScript Libraries
import sys
import clr
clr.AddReference('ProtoGeometry')
from Autodesk.DesignScript.Geometry import *

clr.AddReference('RevitAPI')
from Autodesk.Revit.DB import *

clr.AddReference("RevitServices")
import RevitServices
from RevitServices.Persistence import DocumentManager
from RevitServices.Transactions import TransactionManager

clr.AddReference("RevitNodes")
import Revit

doc = DocumentManager.Instance.CurrentDBDocument
from itertools import chain
from collections import defaultdict

#crv = Revit.GeometryConversion.RevitToProtoCurve.ToProtoType( crv, true )

# The inputs to this node will be stored as a list in the IN variables.
dataEnteringNode = IN
fSum = lambda a, *args: reduce(lambda a, f: f(a), a, args)

#alllevels =  FilteredElementCollector(doc).OfClass(Level).WhereElementIsNotElementType().ToElements()

#allgrids = FilteredElementCollector(doc).OfClass(Grid).WhereElementIsNotElementType().ToElements()

allgrids = IN[0]

def extractAllvalues(all_ds, key):
    return list(map(lambda i: i[key], all_ds))

def create_GridDS(grid, allgrids):
    def findDirection(grid):
        gridVector = grid.Curve.Direction.Normalized()
        if gridVector.IsParallel(Vector.XAxis()):
            return "X_axis"
        else:
            return "Y_axis"
            
    x_Grids = list(filter(lambda i: findDirection(i) == "X_axis", allgrids))
    y_Grids = list(filter(lambda i: findDirection(i) == "Y_axis", allgrids))
    
    intPts = []
    if findDirection(grid) == "X_axis":
        intPts = list(map(lambda i: grid.Curve.Intersect(i.Curve), y_Grids))
    else:
        intPts = list(map(lambda i: grid.Curve.Intersect(i.Curve), x_Grids))
    intPts = list(zip(*intPts))
    gridName = grid.Name
    gridCrv = grid.Curve
    gridVector = gridCrv.Direction.Normalized()
    direction = findDirection(grid)
    segments = gridCrv.SplitByPoints(intPts[0])
    
    result = {
        "element": grid,
        "gridName": gridName,
        "gridCrv": gridCrv,
        "gridVector": gridVector,
        "direction": direction,
        "intPts": intPts,
        "segments": segments
        }
    return result
    

# Place your code below this line

all_GridDS = list(map(lambda i: create_GridDS(i, allgrids), allgrids))

result = all_GridDS
# Assign your output to the OUT variable.
OUT = result
# ----------------------------------------
python_script_9 = Python()  # CPython3; unwired: IN[0]
# ---------- python_script_9.python (26 lines) ----------
# Load the Python Standard and DesignScript Libraries
import sys
import clr
clr.AddReference('ProtoGeometry')
from Autodesk.DesignScript.Geometry import *

# The inputs to this node will be stored as a list in the IN variables.
dataEnteringNode = IN

# Place your code below this line
from itertools import chain
from collections import defaultdict

d1 = {'a': 1, 'b': 2, 'c': 3}
d2 = {'c': 4, 'd': 5, 'e': 6}

d3 = defaultdict(list)

for k, v in chain(d1.items(), d2.items()):
    d3[k].append(v)

result = d3


# Assign your output to the OUT variable.
OUT = result
# ----------------------------------------
splitByPoints = Curve.SplitByPoints()  # unwired: curve, points
