# Dynamo graph 3_Modelization(1223)_forWall.dyn (Dynamo 2.10.1.3976)

# group: All Levels Elements
categories = Categories("OST_Levels")
all_elements_of_category = ElementsOfCategory(Category=categories)

# group: LevelsExceptB
string_from_web = Python()  # CPython3; unwired: IN[0]
# ---------- string_from_web.python (19 lines) ----------
# Load the Python Standard and DesignScript Libraries
import sys
import clr
clr.AddReference('ProtoGeometry')
from Autodesk.DesignScript.Geometry import *
import urllib.request

# The inputs to this node will be stored as a list in the IN variables.
dataEnteringNode = IN
inputURL = "https://raw.githubusercontent.com/HNANmal/mQ/master/Hdynlib/Revit/Elements/Filtering/FilterElementsExceptTarget.py"

# Place your code below this line
req = urllib.request
data = req.urlopen(inputURL)

result = data.read().decode("utf-8")

# Assign your output to the OUT variable.
OUT = result
# ----------------------------------------
boolean = BoolSelector(false)
code_block = CodeBlock { "B"; }
filterelementsexcepttarget = PythonStringNode(script=string_from_web, IN[0]=all_elements_of_category, IN[1]=boolean, IN[2]=code_block)  # CPython3

# group: All Room Elements
categories_2 = Categories("OST_Rooms")
all_elements_of_category_2 = ElementsOfCategory(Category=categories_2)

# group: Create RoomDS(Data Structure)
string_from_web_2 = Python()  # CPython3; unwired: IN[0]
# ---------- string_from_web_2.python (19 lines) ----------
# Load the Python Standard and DesignScript Libraries
import sys
import clr
clr.AddReference('ProtoGeometry')
from Autodesk.DesignScript.Geometry import *
import urllib.request

# The inputs to this node will be stored as a list in the IN variables.
dataEnteringNode = IN
inputURL = "https://raw.githubusercontent.com/HNANmal/mQ/master/Hdynlib/DataStructure/Custom/Rooms/CreateRoomDS.py"

# Place your code below this line
req = urllib.request
data = req.urlopen(inputURL)

result = data.read().decode("utf-8")

# Assign your output to the OUT variable.
OUT = result
# ----------------------------------------
createroomds = PythonStringNode(script=string_from_web_2, IN[1]=all_elements_of_category_2)  # CPython3; unwired: IN[0]

# group: All Grids Elements
categories_3 = Categories("OST_Grids")
all_elements_of_category_3 = ElementsOfCategory(Category=categories_3)

# group: Create GridDS(Data Structure)
python_script_create_gridds = Python(IN[0]=all_elements_of_category_3)  # CPython3
# ---------- python_script_create_gridds.python (80 lines) ----------
# Load the Python Standard and DesignScript Libraries
import sys
import clr
clr.AddReference('ProtoGeometry')
from Autodesk.DesignScript.Geometry import *

clr.AddReference('RevitAPI')
from Autodesk.Revit.DB import *

clr.AddReference("RevitServices")
import RevitServices
from RevitServices.Persistence import DocumentManager
from RevitServices.Transactions import TransactionManager

clr.AddReference("RevitNodes")
import Revit

doc = DocumentManager.Instance.CurrentDBDocument
from itertools import chain
from collections import defaultdict

# The inputs to this node will be stored as a list in the IN variables.
dataEnteringNode = IN

allgrids = IN[0]

def Create_GridDS(grid, allgrids):
    def findDirection(grid):
        gridVector = grid.Curve.Direction.Normalized()
        if gridVector.IsParallel(Vector.XAxis()):
            return "X_axis"
        else:
            return "Y_axis"
            
    x_Grids = list(filter(lambda i: findDirection(i) == "X_axis", allgrids))
    y_Grids = list(filter(lambda i: findDirection(i) == "Y_axis", allgrids))
    
    intPtsDict = []
    if findDirection(grid) == "X_axis":
        for i in y_Grids:
            tmp = {}
            mark = '-'.join([grid.Name, i.Name])
            tmp[f'{mark}'] = grid.Curve.Intersect(i.Curve)
            intPtsDict.append(tmp)
        
    else:
        for i in x_Grids:
            tmp = {}
            mark = '-'.join([i.Name, grid.Name])
            tmp[f'{mark}'] = grid.Curve.Intersect(i.Curve)
            intPtsDict.append(tmp)
        
    _intPts = list(map(lambda i: i.values(), intPtsDict))
    intPts = list(chain(*chain(*_intPts)))
    gridName = grid.Name
    gridCrv = grid.Curve
    gridVector = gridCrv.Direction.Normalized()
    direction = findDirection(grid)
    segments = gridCrv.SplitByPoints(intPts)
    
    result = {
        "element": grid,
        "gridName": gridName,
        "gridCrv": gridCrv,
        "gridVector": gridVector,
        "direction": direction,
        "intPtsDict": intPtsDict,
        "intPts": intPts,
        "segments": segments
        }
    return result
    

# Place your code below this line

all_GridDS = list(map(lambda i: Create_GridDS(i, allgrids), allgrids))

result = all_GridDS
# Assign your output to the OUT variable.
OUT = result
# ----------------------------------------

dataHub = CodeBlock(AllLevels=all_elements_of_category, LevelsExceptB=filterelementsexcepttarget, RoomDS=createroomds, GridDS=python_script_create_gridds)
# ---------- dataHub.designscript (10 lines) ----------
DataHub = {
	"AllLevels": AllLevels,
	"LevelsExceptB": LevelsExceptB,
	"RoomDS": RoomDS,
	"GridDS": GridDS
};
DataHub["AllLevels"];
DataHub["LevelsExceptB"];
DataHub["RoomDS"];
DataHub["GridDS"];
# ----------------------------------------

# group: 추가 데이터 조작 및 정렬
string_from_web_3 = Python()  # CPython3; unwired: IN[0]; same code as string_from_web
gridDS = CodeBlock(DataHub=dataHub.DataHub)
# ---------- gridDS.designscript (30 lines) ----------
DataHub;
DataHub["AllLevels"];
DataHub["LevelsExceptB"];
DataHub["RoomDS"];
DataHub["RoomDS"]["name"];
DataHub["RoomDS"]["level"];
DataHub["RoomDS"]["department"];
DataHub["RoomDS"]["roomelem"];
DataHub["RoomDS"]["roomsolid"];
DataHub["RoomDS"]["basefinish"];
DataHub["RoomDS"]["ceilfinish"];
DataHub["RoomDS"]["wallfinish"];
DataHub["RoomDS"]["floorfinish"];
DataHub["RoomDS"]["rooffinish"];
DataHub["RoomDS"]["extwallfinish"];
DataHub["RoomDS"]["roomsideface"];
DataHub["RoomDS"]["roomupperface"];
DataHub["RoomDS"]["roombottomface"];
DataHub["RoomDS"]["roomperimeter"];
DataHub["RoomDS"]["adjrooms"];
DataHub["RoomDS"]["surfacedict"];
DataHub["GridDS"];
DataHub["GridDS"]["element"];
DataHub["GridDS"]["gridName"];
DataHub["GridDS"]["gridCrv"];
DataHub["GridDS"]["gridVector"];
DataHub["GridDS"]["direction"];
DataHub["GridDS"]["intPtsDict"];
DataHub["GridDS"]["intPts"];
DataHub["GridDS"]["segments"];
# ----------------------------------------
boolean_2 = BoolSelector(true)
code_block_2 = CodeBlock { "B"; }
filterelementsexcepttarget_2 = PythonStringNode(script=string_from_web_3, IN[0]=gridDS.out1, IN[1]=boolean_2, IN[2]=code_block_2)  # CPython3
code_block_3 = CodeBlock { "level"; }
valueAtKey = DesignScript.Builtin.Dictionary.ValueAtKey(key=code_block_3)  # unwired: dictionary
groupByFunction = List.GroupByFunction(list=gridDS.out3, groupFunction=valueAtKey)
code_block_4 = CodeBlock(i=groupByFunction) { i["surfacedict"]; }

wall_types = WallTypes("WA221_Interior-Cement Block-190mm")
code_block_5 = CodeBlock(LevelsExceptB=gridDS.out2) { LevelsExceptB; }
code_block_6 = CodeBlock(i=code_block_4) { i["Int Surfaces"]; }

# group (continued): 추가 데이터 조작 및 정렬
flatten = List.Flatten(list=code_block_6@L3)

findUniqueSrf = Python(IN[0]=flatten)  # CPython3
# ---------- findUniqueSrf.python (54 lines) ----------
# Load the Python Standard and DesignScript Libraries
import sys
import clr
clr.AddReference('ProtoGeometry')
from Autodesk.DesignScript.Geometry import *

# The inputs to this node will be stored as a list in the IN variables.
dataEnteringNode = IN
surfaceGroup = IN[0]

# Place your code below this line

def findUniqueSrf(surfaces):
    def findintscsurfaces(surfaces):
        final = []
        idx_log = []
        
        for i in surfaces:
            tmp = []
            idx = surfaces.index(i)
            if idx in idx_log:
                pass
            else:
                for j in surfaces:
                    target = i
                    target_bdry = PolyCurve.ByJoinedCurves(target.PerimeterCurves())
                    targetsrf = Surface.ByPatch(target_bdry.Offset(-10))
                    if targetsrf.DoesIntersect(j):
                        tmp.append(j)
                        idx_log.append(surfaces.index(j))
                    else:
                        pass
            final.append(tmp)
        result = list(filter(lambda i: len(i)>0, final))
        return result
    
    duplicatedlist = findintscsurfaces(surfaces)
    
    result = []
            
    for i in duplicatedlist:
        arealist = list(map( lambda x: x.Area, i))
        maxval = max(arealist)
        idx = arealist.index(maxval)
        result.append(i[idx])
        
    return result

result = []
for surfaces in surfaceGroup:
    tmp = findUniqueSrf(surfaces)
    result.append(tmp)
# Assign your output to the OUT variable.
OUT = result
# ----------------------------------------
findWallCrvAndheight = Python(IN[0]=findUniqueSrf)  # CPython3
# ---------- findWallCrvAndheight.python (33 lines) ----------
# Load the Python Standard and DesignScript Libraries
import sys
import clr
clr.AddReference('ProtoGeometry')
from Autodesk.DesignScript.Geometry import *

from itertools import chain

# The inputs to this node will be stored as a list in the IN variables.
dataEnteringNode = IN
surfaceGroup = IN[0]

# Place your code below this line

def findWallCrvAndHeight(surface):
    alllines = surface.PerimeterCurves()
    horCrv = list(filter(lambda x: x.Direction.Z==0, alllines))
    verCrv = list(filter(lambda x: x.Direction.Z!=0, alllines))
    height = round(verCrv[0].Length)
    MaxHorCrvZ = max(list(map(lambda y: y.StartPoint.Z, horCrv)))
    wallCrv = list(filter(lambda x: x.StartPoint.Z==MaxHorCrvZ, horCrv))[0]
    
    return (wallCrv, height)

result = []
for i in surfaceGroup:
    tmp = []
    for surface in i:
        tmp.append(findWallCrvAndHeight(surface))
    result.append(tmp)
    
# Assign your output to the OUT variable.
OUT = result
# ----------------------------------------
byCurveAndHeight = Python(IN[0]=wall_types, IN[1]=code_block_5, IN[2]=findWallCrvAndheight)  # "Wall.ByCurveAndHeight"; CPython3
# ---------- byCurveAndHeight.python (41 lines) ----------
# Load the Python Standard and DesignScript Libraries
import sys
import clr
clr.AddReference('ProtoGeometry')
from Autodesk.DesignScript.Geometry import *

clr.AddReference("RevitNodes")
import Revit

from Revit.Elements import *

clr.AddReference("DSCoreNodes")
from DSCore import *

clr.AddReference('RevitServices')
import RevitServices
from RevitServices.Persistence import DocumentManager
from RevitServices.Transactions import TransactionManager

doc = DocumentManager.Instance.CurrentDBDocument

# The inputs to this node will be stored as a list in the IN variables.
dataEnteringNode = IN
wallType = IN[0]
levels = IN[1]
linesGroupByLevel = IN[2]

# Place your code below this line
result = []
for i in range(len(linesGroupByLevel)):
    tmp = []
    for j in linesGroupByLevel[i]:
        crv = j[0]
        height = j[1]
        level = levels[i]
        wall = Wall.ByCurveAndHeight(crv, height, level, wallType)
        tmp.append(wall)
    result.append(tmp)

# Assign your output to the OUT variable.
OUT = result
# ----------------------------------------
code_block_7 = CodeBlock(i=groupByFunction) { i["level"]; }
wall_types_2 = WallTypes("WA211_Exterior-Cement Brick-90mm")
code_block_8 = CodeBlock(i=code_block_4) { i["Ext Surfaces"]; }
flatten_2 = List.Flatten(list=code_block_8@L3)
findWallCrvAndLevelOrHeight = Python(IN[0]=flatten_2, IN[1]=code_block_5)  # CPython3
# ---------- findWallCrvAndLevelOrHeight.python (47 lines) ----------
# Load the Python Standard and DesignScript Libraries
import sys
import clr
clr.AddReference('ProtoGeometry')
from Autodesk.DesignScript.Geometry import *

from itertools import chain

# The inputs to this node will be stored as a list in the IN variables.
dataEnteringNode = IN
surfaceGroup = IN[0]
levels = IN[1]

# Place your code below this line

def findWallCrvAndHeight(surface):
    alllines = surface.PerimeterCurves()
    horCrv = list(filter(lambda x: x.Direction.Z==0, alllines))
    verCrv = list(filter(lambda x: x.Direction.Z!=0, alllines))
    height = round(verCrv[0].Length)
    MaxHorCrvZ = max(list(map(lambda y: y.StartPoint.Z, horCrv)))
    wallCrv = list(filter(lambda x: x.StartPoint.Z==MaxHorCrvZ, horCrv))[0]
    
    return (wallCrv, height)

def findWallCrvAndLevel(surface, fromLev, toLev):
    alllines = surface.PerimeterCurves()
    horCrv = list(filter(lambda x: x.Direction.Z==0, alllines))
    verCrv = list(filter(lambda x: x.Direction.Z!=0, alllines))
    height = round(verCrv[0].Length)
    MaxHorCrvZ = max(list(map(lambda y: y.StartPoint.Z, horCrv)))
    wallCrv = list(filter(lambda x: x.StartPoint.Z==MaxHorCrvZ, horCrv))[0]
    
    return (wallCrv, fromLev, toLev)

result = []
for i in range(len(surfaceGroup)):
    tmp = []
    for surface in surfaceGroup[i]:
        if i < len(surfaceGroup)-1:
            tmp.append(findWallCrvAndLevel(surface, levels[i], levels[i+1]))
        else:
            tmp.append(findWallCrvAndHeight(surface))
    result.append(tmp)
    
# Assign your output to the OUT variable.
OUT = result
# ----------------------------------------
byCurveAndHeightOrLevel = Python(IN[0]=wall_types_2, IN[1]=code_block_5, IN[2]=findWallCrvAndLevelOrHeight)  # "Wall.ByCurveAndHeightOrLevel"; CPython3
# ---------- byCurveAndHeightOrLevel.python (48 lines) ----------
# Load the Python Standard and DesignScript Libraries
import sys
import clr
clr.AddReference('ProtoGeometry')
from Autodesk.DesignScript.Geometry import *

clr.AddReference("RevitNodes")
import Revit

from Revit.Elements import *

clr.AddReference("DSCoreNodes")
from DSCore import *

clr.AddReference('RevitServices')
import RevitServices
from RevitServices.Persistence import DocumentManager
from RevitServices.Transactions import TransactionManager

doc = DocumentManager.Instance.CurrentDBDocument

# The inputs to this node will be stored as a list in the IN variables.
dataEnteringNode = IN
wallType = IN[0]
levels = IN[1]
linesGroupByLevel = IN[2]

# Place your code below this line
result = []
for i in range(len(linesGroupByLevel)):
    tmp = []
    for j in linesGroupByLevel[i]:
        if len(j) < 3:
            crv = j[0]
            height = j[1]
            level = levels[i]
            wall = Wall.ByCurveAndHeight(crv, height, level, wallType)
            tmp.append(wall)
        else:
            crv = j[0]
            sttLevel = j[1]
            endLevel = j[2]
            wall = Wall.ByCurveAndLevels(crv, sttLevel, endLevel, wallType)
            tmp.append(wall)
    result.append(tmp)

# Assign your output to the OUT variable.
OUT = result
# ----------------------------------------
