# Dynamo graph 3_Modelization(1227).dyn (Dynamo 2.10.1.3976)

# group: All Levels Elements
categories = Categories("OST_Levels")
all_elements_of_category = ElementsOfCategory(Category=categories)

# group: LevelsExceptB
string_from_web = Python()  # CPython3; unwired: IN[0]
# ---------- string_from_web.python (19 lines) ----------
# Load the Python Standard and DesignScript Libraries
import sys
import clr
clr.AddReference('ProtoGeometry')
from Autodesk.DesignScript.Geometry import *
import urllib.request

# The inputs to this node will be stored as a list in the IN variables.
dataEnteringNode = IN
inputURL = "https://raw.githubusercontent.com/HNANmal/mQ/master/Hdynlib/Revit/Elements/Filtering/FilterElementsExceptTarget.py"

# Place your code below this line
req = urllib.request
data = req.urlopen(inputURL)

result = data.read().decode("utf-8")

# Assign your output to the OUT variable.
OUT = result
# ----------------------------------------
boolean = BoolSelector(false)
code_block = CodeBlock { "B"; }
filterelementsexcepttarget = PythonStringNode(script=string_from_web, IN[0]=all_elements_of_category, IN[1]=boolean, IN[2]=code_block)  # CPython3

# group: All Room Elements
categories_2 = Categories("OST_Rooms")
all_elements_of_category_2 = ElementsOfCategory(Category=categories_2)

# group: Create RoomDS(Data Structure)
string_from_web_2 = Python()  # CPython3; unwired: IN[0]
# ---------- string_from_web_2.python (19 lines) ----------
# Load the Python Standard and DesignScript Libraries
import sys
import clr
clr.AddReference('ProtoGeometry')
from Autodesk.DesignScript.Geometry import *
import urllib.request

# The inputs to this node will be stored as a list in the IN variables.
dataEnteringNode = IN
inputURL = "https://raw.githubusercontent.com/HNANmal/mQ/master/Hdynlib/DataStructure/Custom/Rooms/CreateRoomDS.py"

# Place your code below this line
req = urllib.request
data = req.urlopen(inputURL)

result = data.read().decode("utf-8")

# Assign your output to the OUT variable.
OUT = result
# ----------------------------------------
createroomds = PythonStringNode(script=string_from_web_2, IN[1]=all_elements_of_category_2)  # CPython3; unwired: IN[0]

# group: All Grids Elements
categories_3 = Categories("OST_Grids")
all_elements_of_category_3 = ElementsOfCategory(Category=categories_3)

# group: Create GridDS(Data Structure)
python_script_create_gridds = Python(IN[0]=all_elements_of_category_3)  # CPython3
# ---------- python_script_create_gridds.python (80 lines) ----------
# Load the Python Standard and DesignScript Libraries
import sys
import clr
clr.AddReference('ProtoGeometry')
from Autodesk.DesignScript.Geometry import *

clr.AddReference('RevitAPI')
from Autodesk.Revit.DB import *

clr.AddReference("RevitServices")
import RevitServices
from RevitServices.Persistence import DocumentManager
from RevitServices.Transactions import TransactionManager

clr.AddReference("RevitNodes")
import Revit

doc = DocumentManager.Instance.CurrentDBDocument
from itertools import chain
from collections import defaultdict

# The inputs to this node will be stored as a list in the IN variables.
dataEnteringNode = IN

allgrids = IN[0]

def Create_GridDS(grid, allgrids):
    def findDirection(grid):
        gridVector = grid.Curve.Direction.Normalized()
        if gridVector.IsParallel(Vector.XAxis()):
            return "X_axis"
        else:
            return "Y_axis"
            
    x_Grids = list(filter(lambda i: findDirection(i) == "X_axis", allgrids))
    y_Grids = list(filter(lambda i: findDirection(i) == "Y_axis", allgrids))
    
    intPtsDict = []
    if findDirection(grid) == "X_axis":
        for i in y_Grids:
            tmp = {}
            mark = '-'.join([grid.Name, i.Name])
            tmp[f'{mark}'] = grid.Curve.Intersect(i.Curve)
            intPtsDict.append(tmp)
        
    else:
        for i in x_Grids:
            tmp = {}
            mark = '-'.join([i.Name, grid.Name])
            tmp[f'{mark}'] = grid.Curve.Intersect(i.Curve)
            intPtsDict.append(tmp)
        
    _intPts = list(map(lambda i: i.values(), intPtsDict))
    intPts = list(chain(*chain(*_intPts)))
    gridName = grid.Name
    gridCrv = grid.Curve
    gridVector = gridCrv.Direction.Normalized()
    direction = findDirection(grid)
    segments = gridCrv.SplitByPoints(intPts)
    
    result = {
        "element": grid,
        "gridName": gridName,
        "gridCrv": gridCrv,
        "gridVector": gridVector,
        "direction": direction,
        "intPtsDict": intPtsDict,
        "intPts": intPts,
        "segments": segments
        }
    return result
    

# Place your code below this line

all_GridDS = list(map(lambda i: Create_GridDS(i, allgrids), allgrids))

result = all_GridDS
# Assign your output to the OUT variable.
OUT = result
# ----------------------------------------

dataHub = CodeBlock(AllLevels=all_elements_of_category, LevelsExceptB=filterelementsexcepttarget, RoomDS=createroomds, GridDS=python_script_create_gridds)
# ---------- dataHub.designscript (10 lines) ----------
DataHub = {
	"AllLevels": AllLevels,
	"LevelsExceptB": LevelsExceptB,
	"RoomDS": RoomDS,
	"GridDS": GridDS
};
DataHub["AllLevels"];
DataHub["LevelsExceptB"];
DataHub["RoomDS"];
DataHub["GridDS"];
# ----------------------------------------

# group: 추가 데이터 조작 및 정렬
gridDS = CodeBlock(DataHub=dataHub.DataHub)
# ---------- gridDS.designscript (30 lines) ----------
DataHub;
DataHub["AllLevels"];
DataHub["LevelsExceptB"];
DataHub["RoomDS"];
DataHub["RoomDS"]["name"];
DataHub["RoomDS"]["level"];
DataHub["RoomDS"]["department"];
DataHub["RoomDS"]["roomelem"];
DataHub["RoomDS"]["roomsolid"];
DataHub["RoomDS"]["basefinish"];
DataHub["RoomDS"]["ceilfinish"];
DataHub["RoomDS"]["wallfinish"];
DataHub["RoomDS"]["floorfinish"];
DataHub["RoomDS"]["rooffinish"];
DataHub["RoomDS"]["extwallfinish"];
DataHub["RoomDS"]["roomsideface"];
DataHub["RoomDS"]["roomupperface"];
DataHub["RoomDS"]["roombottomface"];
DataHub["RoomDS"]["roomperimeter"];
DataHub["RoomDS"]["adjrooms"];
DataHub["RoomDS"]["surfacedict"];
DataHub["GridDS"];
DataHub["GridDS"]["element"];
DataHub["GridDS"]["gridName"];
DataHub["GridDS"]["gridCrv"];
DataHub["GridDS"]["gridVector"];
DataHub["GridDS"]["direction"];
DataHub["GridDS"]["intPtsDict"];
DataHub["GridDS"]["intPts"];
DataHub["GridDS"]["segments"];
# ----------------------------------------
code_block_2 = CodeBlock(i=gridDS.out21) { i["direction"]=="X_axis"; }
filterByBoolMask = List.FilterByBoolMask(list=gridDS.out21, mask=code_block_2)
code_block_3 = CodeBlock(pGridDS=filterByBoolMask.in) { pGridDS["intPts"]; }
string_from_web_3 = Python()  # CPython3; unwired: IN[0]; same code as string_from_web
boolean_2 = BoolSelector(true)
code_block_4 = CodeBlock { "B"; }
filterelementsexcepttarget_2 = PythonStringNode(script=string_from_web_3, IN[0]=gridDS.out1, IN[1]=boolean_2, IN[2]=code_block_4)  # CPython3

# group: 기초 배치구간
structural_foundation_family = FamilyTypes("FT112-Footing-Rectangular:FT112_2400x2400x500")  # "Structural Foundation Family Types 선택"; graph input
code_block_5 = CodeBlock(intPts=code_block_3, level_B=filterelementsexcepttarget_2) { intPts; level_B; }
flatten = List.Flatten(list=code_block_5.intPts)
byPointAndLevel = FamilyInstance.ByPointAndLevel(familyType=structural_foundation_family, point=flatten, level=code_block_5.level_B, lacing=CrossProduct)

# group: 페데스탈 배치구간
structural_column_types_선택 = StructuralColumnTypes("CL111_500x500")
code_block_6 = CodeBlock(intPts=code_block_3, level_B=filterelementsexcepttarget_2) { intPts; level_B; }
flatten_2 = List.Flatten(list=code_block_6.intPts)
byPointAndLevel_2 = FamilyInstance.ByPointAndLevel(familyType=structural_column_types_선택, point=flatten_2, level=code_block_6.level_B, lacing=CrossProduct)

# group: 기둥 배치구간
structural_column_types_선택_2 = StructuralColumnTypes("CL111_500x500")
code_block_7 = CodeBlock(intPts=code_block_3, LevelsExceptB=gridDS.out2) { intPts; LevelsExceptB; }
flatten_3 = List.Flatten(list=code_block_7.intPts)
byPointAndLevel_3 = FamilyInstance.ByPointAndLevel(familyType=structural_column_types_선택_2, point=flatten_3, level=code_block_7.LevelsExceptB, lacing=CrossProduct)

# group: 추가 데이터 조작 및 정렬
gridDS_2 = CodeBlock(DataHub=dataHub.DataHub)  # same code as gridDS
code_block_8 = CodeBlock(i=gridDS_2.out21) { i["direction"]=="X_axis"; }
filterByBoolMask_2 = List.FilterByBoolMask(list=gridDS_2.out21, mask=code_block_8)
code_block_9 = CodeBlock(XGridDS=filterByBoolMask_2.in) { XGridDS["segments"]; }
code_block_10 = CodeBlock { 1; }
dropItems = List.DropItems(list=code_block_9@L2, amount=code_block_10)
code_block_11 = CodeBlock { -1; }
dropItems_2 = List.DropItems(list=dropItems@L2, amount=code_block_11)
code_block_12 = CodeBlock(segmentsX_real=dropItems_2) { segmentsX_real; }
code_block_13 = CodeBlock(YGridDS=filterByBoolMask_2.out) { YGridDS["segments"]; }
code_block_14 = CodeBlock { 1; }
dropItems_3 = List.DropItems(list=code_block_13@L2, amount=code_block_14)
code_block_15 = CodeBlock { -1; }
dropItems_4 = List.DropItems(list=dropItems_3@L2, amount=code_block_15)
code_block_16 = CodeBlock(segmentsY_real=dropItems_4) { segmentsY_real; }
string_from_web_4 = Python()  # CPython3; unwired: IN[0]; same code as string_from_web
boolean_3 = BoolSelector(true)
code_block_17 = CodeBlock { "B"; }
filterelementsexcepttarget_3 = PythonStringNode(script=string_from_web_4, IN[0]=gridDS_2.out1, IN[1]=boolean_3, IN[2]=code_block_17)  # CPython3

# group: 타이거더 배치 구간(Y 축 방향)
code_block_18 = CodeBlock(segmentsX_real=code_block_12, segmentsY_real=code_block_16, level_B=filterelementsexcepttarget_3) { segmentsX_real; segmentsY_real; level_B; }
flatten_4 = List.Flatten(list=code_block_18.segmentsY_real)
지중보_girder_family_types_선택 = FamilyTypes("Concrete-Rectangular-Beam:BM111_400x500_RG1")  # graph input
beamByCurve = StructuralFraming.BeamByCurve(curve=flatten_4, level=code_block_18.level_B, structuralFramingType=지중보_girder_family_types_선택, lacing=CrossProduct)

# group: 타이빔 배치 구간(Y 축 방향)
타이빔_y축_방향_생성_여부 = BoolSelector(true)  # graph input
code_block_19 = CodeBlock(segmentsX_real=code_block_12, segmentsY_real=code_block_16, level_B=filterelementsexcepttarget_3) { segmentsX_real; segmentsY_real; level_B; }
transpose = List.Transpose(lists=code_block_19.segmentsX_real)
code_block_20 = CodeBlock { 0.5; }
pointAtParameter = Curve.PointAtParameter(curve=transpose, param=code_block_20)
createCurveForBeam = Python(IN[0]=pointAtParameter)  # CPython3
# ---------- createCurveForBeam.python (21 lines) ----------
# Load the Python Standard and DesignScript Libraries
import sys
import clr
clr.AddReference('ProtoGeometry')
from Autodesk.DesignScript.Geometry import *

# The inputs to this node will be stored as a list in the IN variables.
dataEnteringNode = IN
ptsGroup = IN[0]

# Place your code below this line
result = []
for i in ptsGroup:
    for j in range(len(i)):
        if j < len(i)-1:
            result.append(Line.ByStartPointEndPoint(i[j], i[j+1]))
        else:
            pass

# Assign your output to the OUT variable.
OUT = result
# ----------------------------------------
실행여부_결정 = Python(IN[0]=타이빔_y축_방향_생성_여부, IN[1]=createCurveForBeam)  # CPython3
# ---------- 실행여부_결정.python (21 lines) ----------
# Load the Python Standard and DesignScript Libraries
import sys
import clr
clr.AddReference('ProtoGeometry')
from Autodesk.DesignScript.Geometry import *

# The inputs to this node will be stored as a list in the IN variables.
dataEnteringNode = IN

bln = IN[0]
inputs = IN[1]

# Place your code below this line

if bln:
    result = inputs
else:
    result = []

# Assign your output to the OUT variable.
OUT = result
# ----------------------------------------
지중보_beam_family_types_선택 = FamilyTypes("Concrete-Rectangular-Beam:BM111_400x500_RG1")  # graph input
beamByCurve_2 = StructuralFraming.BeamByCurve(curve=실행여부_결정, level=code_block_19.level_B, structuralFramingType=지중보_beam_family_types_선택, lacing=CrossProduct)

# group: 타이거더 배치 구간(X 축 방향)
code_block_21 = CodeBlock(segmentsX_real=code_block_12, segmentsY_real=code_block_16, level_B=filterelementsexcepttarget_3) { segmentsX_real; segmentsY_real; level_B; }
flatten_5 = List.Flatten(list=code_block_21.segmentsX_real)
beamByCurve_3 = StructuralFraming.BeamByCurve(curve=flatten_5, level=code_block_21.level_B, structuralFramingType=지중보_girder_family_types_선택, lacing=CrossProduct)

# group: 타이빔 배치 구간(X 축 방향)
타이빔_x축_방향_생성_여부 = BoolSelector(false)  # graph input
code_block_22 = CodeBlock(segmentsX_real=code_block_12, segmentsY_real=code_block_16, level_B=filterelementsexcepttarget_3) { segmentsX_real; segmentsY_real; level_B; }
transpose_2 = List.Transpose(lists=code_block_22.segmentsY_real)
code_block_23 = CodeBlock { 0.5; }
pointAtParameter_2 = Curve.PointAtParameter(curve=transpose_2, param=code_block_23)
createCurveForBeam_2 = Python(IN[0]=pointAtParameter_2)  # CPython3; same code as createCurveForBeam
실행여부_결정_2 = Python(IN[0]=타이빔_x축_방향_생성_여부, IN[1]=createCurveForBeam_2)  # CPython3; same code as 실행여부_결정
beamByCurve_4 = StructuralFraming.BeamByCurve(curve=실행여부_결정_2, level=code_block_22.level_B, structuralFramingType=지중보_beam_family_types_선택, lacing=CrossProduct)

# group: 추가 데이터 조작 및 정렬
string_from_web_5 = Python()  # CPython3; unwired: IN[0]; same code as string_from_web
gridDS_3 = CodeBlock(DataHub=dataHub.DataHub)  # same code as gridDS
boolean_4 = BoolSelector(true)
code_block_24 = CodeBlock { "B"; }
filterelementsexcepttarget_4 = PythonStringNode(script=string_from_web_5, IN[0]=gridDS_3.out1, IN[1]=boolean_4, IN[2]=code_block_24)  # CPython3
code_block_25 = CodeBlock(i=gridDS_3.out21) { i["direction"]=="X_axis"; }
filterByBoolMask_3 = List.FilterByBoolMask(list=gridDS_3.out21, mask=code_block_25)
code_block_26 = CodeBlock(XGridDS=filterByBoolMask_3.in) { XGridDS["segments"]; }
code_block_27 = CodeBlock { 1; }
dropItems_5 = List.DropItems(list=code_block_26@L2, amount=code_block_27)
code_block_28 = CodeBlock { -1; }
dropItems_6 = List.DropItems(list=dropItems_5@L2, amount=code_block_28)
code_block_29 = CodeBlock(segmentsX_real=dropItems_6) { segmentsX_real; }
code_block_30 = CodeBlock(YGridDS=filterByBoolMask_3.out) { YGridDS["segments"]; }
code_block_31 = CodeBlock { 1; }
dropItems_7 = List.DropItems(list=code_block_30@L2, amount=code_block_31)
code_block_32 = CodeBlock { -1; }
dropItems_8 = List.DropItems(list=dropItems_7@L2, amount=code_block_32)
code_block_33 = CodeBlock(segmentsY_real=dropItems_8) { segmentsY_real; }

# group: 추가 데이터 조작 및 정렬
string_from_web_6 = Python()  # CPython3; unwired: IN[0]; same code as string_from_web
gridDS_4 = CodeBlock(DataHub=dataHub.DataHub)  # same code as gridDS
boolean_5 = BoolSelector(true)
code_block_34 = CodeBlock { "B"; }
filterelementsexcepttarget_5 = PythonStringNode(script=string_from_web_6, IN[0]=gridDS_4.out1, IN[1]=boolean_5, IN[2]=code_block_34)  # CPython3
code_block_35 = CodeBlock { "level"; }
valueAtKey = DesignScript.Builtin.Dictionary.ValueAtKey(key=code_block_35)  # unwired: dictionary
groupByFunction = List.GroupByFunction(list=gridDS_4.out3, groupFunction=valueAtKey)
code_block_36 = CodeBlock(i=groupByFunction) { i["roombottomface"]; }
flatten_6 = List.Flatten(list=code_block_36@L3)
perimeterCurves = Surface.PerimeterCurves(surface=flatten_6)
byJoinedCurves = PolyCurve.ByJoinedCurves(curves=perimeterCurves)
code_block_37 = CodeBlock(i=groupByFunction) { i["level"]; }

# group: 플로어 슬라브 배치구간
code_block_38 = CodeBlock(floorcrv=byJoinedCurves, LevelsExceptB=gridDS_4.out2) { floorcrv; LevelsExceptB; }
floor_types_선택 = FloorTypes("CFS11_Slab RC_T150")  # graph input
byOutlineTypeAndLevel = Floor.ByOutlineTypeAndLevel(outlineCurves=code_block_38.floorcrv, floorType=floor_types_선택, level=code_block_38.LevelsExceptB)

string_from_web_7 = Python()  # CPython3; unwired: IN[0]; same code as string_from_web
code_block_39 = CodeBlock(LevelsExceptB=gridDS_2.out2) { LevelsExceptB; }
boolean_6 = BoolSelector(false)
code_block_40 = CodeBlock { "G"; }
filterelementsexcepttarget_6 = PythonStringNode(script=string_from_web_7, IN[0]=code_block_39, IN[1]=boolean_6, IN[2]=code_block_40)  # CPython3

# group: 거더 배치 구간(Y 축 방향)
code_block_41 = CodeBlock(segmentsX_real=code_block_12, segmentsY_real=code_block_16, LevelsExceptB=filterelementsexcepttarget_6) { segmentsX_real; segmentsY_real; LevelsExceptB; }
flatten_7 = List.Flatten(list=code_block_41.segmentsY_real)
elevation = Level.Elevation(level=code_block_41.LevelsExceptB)
translate = Geometry.Translate(geometry=flatten_7, zTranslation=elevation, lacing=CrossProduct)
transpose_3 = List.Transpose(lists=translate)
girder_family_types_선택 = FamilyTypes("Concrete-Rectangular-Beam:BM111_400x500_RG1")  # graph input
beamByCurve_5 = Python(IN[0]=transpose_3, IN[1]=code_block_41.LevelsExceptB, IN[2]=girder_family_types_선택)  # "StructuralFraming.BeamByCurve"; CPython3
# ---------- beamByCurve_5.python (46 lines) ----------
# Load the Python Standard and DesignScript Libraries
import sys
import clr
clr.AddReference('ProtoGeometry')
from Autodesk.DesignScript.Geometry import *

clr.AddReference("RevitNodes")
import Revit

from Revit.Elements import *

clr.AddReference("DSCoreNodes")
from DSCore import *

clr.AddReference('RevitServices')
import RevitServices
from RevitServices.Persistence import DocumentManager
from RevitServices.Transactions import TransactionManager

doc = DocumentManager.Instance.CurrentDBDocument
#TransactionManager.Instance.EnsureInTransaction(doc)

#TransactionManager.Instance.TransactionTaskDone()

# The inputs to this node will be stored as a list in the IN variables.
dataEnteringNode = IN

crvGroup = IN[0]
levels = IN[1]
type = IN[2]

# Place your code below this line
TransactionManager.Instance.EnsureInTransaction(doc)
result = []
for i in range(len(crvGroup)):
    tmp1 = []
    for j in crvGroup[i]:
        elem = StructuralFraming.BeamByCurve(j, levels[i], type)
        tmp1.append(elem)
    result.append(tmp1)

TransactionManager.Instance.TransactionTaskDone()


# Assign your output to the OUT variable.
OUT = result
# ----------------------------------------

# group: 거더 배치 구간(X 축 방향)
code_block_42 = CodeBlock(segmentsX_real=code_block_12, segmentsY_real=code_block_16, LevelsExceptB=filterelementsexcepttarget_6) { segmentsX_real; segmentsY_real; LevelsExceptB; }
flatten_8 = List.Flatten(list=code_block_42.segmentsX_real)
elevation_2 = Level.Elevation(level=code_block_42.LevelsExceptB)
translate_2 = Geometry.Translate(geometry=flatten_8, zTranslation=elevation_2, lacing=CrossProduct)
transpose_4 = List.Transpose(lists=translate_2)
beamByCurve_6 = Python(IN[0]=transpose_4, IN[1]=code_block_42.LevelsExceptB, IN[2]=girder_family_types_선택)  # "StructuralFraming.BeamByCurve"; CPython3; same code as beamByCurve_5

code_block_43 = CodeBlock(LevelsExceptB=gridDS_2.out2) { LevelsExceptB; }

# group: 빔 배치 구간(Y 축 방향)
타이빔_y축_방향_생성_여부_2 = BoolSelector(true)  # graph input
code_block_44 = CodeBlock(segmentsX_real=code_block_12, segmentsY_real=code_block_16, LevelsExceptB=code_block_43) { segmentsX_real; segmentsY_real; LevelsExceptB; }
transpose_5 = List.Transpose(lists=code_block_44.segmentsX_real)
code_block_45 = CodeBlock { 0.5; }
pointAtParameter_3 = Curve.PointAtParameter(curve=transpose_5, param=code_block_45)
createCurveForBeam_3 = Python(IN[0]=pointAtParameter_3)  # CPython3; same code as createCurveForBeam
elevation_3 = Level.Elevation(level=code_block_44.LevelsExceptB)
translate_3 = Geometry.Translate(geometry=createCurveForBeam_3, zTranslation=elevation_3, lacing=CrossProduct)
transpose_6 = List.Transpose(lists=translate_3)
실행여부_결정_3 = Python(IN[0]=타이빔_y축_방향_생성_여부_2, IN[1]=transpose_6)  # CPython3; same code as 실행여부_결정
beam_family_types_선택 = FamilyTypes("Concrete-Rectangular-Beam:BM111_400x500_RG1")  # graph input
beamByCurve_7 = Python(IN[0]=실행여부_결정_3, IN[1]=code_block_44.LevelsExceptB, IN[2]=beam_family_types_선택)  # "StructuralFraming.BeamByCurve"; CPython3; same code as beamByCurve_5

# group: 빔 배치 구간(X 축 방향)
타이빔_x축_방향_생성_여부_2 = BoolSelector(false)  # graph input
code_block_46 = CodeBlock(segmentsX_real=code_block_12, segmentsY_real=code_block_16, LevelsExceptB=code_block_43) { segmentsX_real; segmentsY_real; LevelsExceptB; }
transpose_7 = List.Transpose(lists=code_block_46.segmentsY_real)
code_block_47 = CodeBlock { 0.5; }
pointAtParameter_4 = Curve.PointAtParameter(curve=transpose_7, param=code_block_47)
createCurveForBeam_4 = Python(IN[0]=pointAtParameter_4)  # CPython3; same code as createCurveForBeam
elevation_4 = Level.Elevation(level=code_block_46.LevelsExceptB)
translate_4 = Geometry.Translate(geometry=createCurveForBeam_4, zTranslation=elevation_4, lacing=CrossProduct)

transpose_8 = List.Transpose(lists=translate_4)

# group (continued): 빔 배치 구간(X 축 방향)
실행여부_결정_4 = Python(IN[0]=타이빔_x축_방향_생성_여부_2, IN[1]=transpose_8)  # CPython3; same code as 실행여부_결정
beamByCurve_8 = Python(IN[0]=실행여부_결정_4, IN[1]=code_block_46.LevelsExceptB, IN[2]=beam_family_types_선택)  # "StructuralFraming.BeamByCurve"; CPython3; same code as beamByCurve_5

code_block_48 = CodeBlock(segmentsX_real=code_block_29, segmentsY_real=code_block_33, LevelsExceptB=gridDS_3.out2, RoomDS=gridDS_3.out3) { segmentsX_real; segmentsY_real; LevelsExceptB; RoomDS; }
join = List.Join(list0=code_block_48.segmentsX_real, list1=code_block_48.segmentsY_real)
code_block_49 = CodeBlock(i=join) { i; }
code_block_50 = CodeBlock(LevelsExceptB=code_block_48.LevelsExceptB) { LevelsExceptB; }
elevation_5 = Level.Elevation()  # unwired: level
sortByFunction = List.SortByFunction(list=code_block_50, sortFunction=elevation_5)
list_lastitem_최상층_찾기 = List.LastItem(list=sortByFunction)
elevation_6 = Level.Elevation(level=list_lastitem_최상층_찾기)
translate_5 = Geometry.Translate(geometry=code_block_49, zTranslation=elevation_6)
code_block_51 = CodeBlock(RoomDS=code_block_48.RoomDS) { RoomDS; }
name = Level.Name(level=list_lastitem_최상층_찾기)
code_block_52 = CodeBlock(i=code_block_51, j=name) { i["level"]==j; }
list_filterbyboolmask_최상층_룸_찾기 = List.FilterByBoolMask(list=code_block_51, mask=code_block_52)
code_block_53 = CodeBlock(i=list_filterbyboolmask_최상층_룸_찾기.in) { i["roombottomface"]; }
flatten_9 = List.Flatten(list=code_block_53)
byJoinedSurfaces = PolySurface.ByJoinedSurfaces(surfaces=flatten_9)
perimeterCurves_2 = Surface.PerimeterCurves(surface=byJoinedSurfaces)
byJoinedCurves_2 = PolyCurve.ByJoinedCurves(curves=perimeterCurves_2)
code_block_54 = CodeBlock { -500; }
offset = Curve.Offset(curve=byJoinedCurves_2, distance=code_block_54)
byPatch = Surface.ByPatch(closedCurve=offset)
doesIntersect = Geometry.DoesIntersect(geometry=translate_5@L2, other=byPatch)
filterByBoolMask_4 = List.FilterByBoolMask(list=translate_5@L2, mask=doesIntersect@L2)
flatten_10 = List.Flatten(list=filterByBoolMask_4.in)
code_block_55 = CodeBlock(forBeam=flatten_10) { forBeam; }
code_block_56 = CodeBlock(i=list_filterbyboolmask_최상층_룸_찾기.in) { i["roomlimitoffset"]; }
maximumItem = List.MaximumItem(list=code_block_56)
translate_6 = Geometry.Translate(geometry=code_block_55, zTranslation=maximumItem)

# group: 최상층 거더 배치 구간(내부)
code_block_57 = CodeBlock(segmentsY_in=translate_6, LevelTop=list_lastitem_최상층_찾기, offset=maximumItem) { segments_out; segmentsY_in; LevelTop; offset; }  # unwired: segments_out
flatten_11 = List.Flatten(list=code_block_57.segmentsY_in)
elevation_7 = Level.Elevation(level=code_block_57.LevelTop)
translate_7 = Geometry.Translate(geometry=flatten_11, zTranslation=elevation_7, lacing=CrossProduct)
girder_family_types_선택_2 = FamilyTypes("Concrete-Rectangular-Beam:BM111_400x500_RG1")  # graph input
beamByCurve_9 = StructuralFraming.BeamByCurve(curve=translate_7, level=code_block_57.LevelTop, structuralFramingType=girder_family_types_선택_2, lacing=CrossProduct)

# group: 높이 보정
code_block_58 = CodeBlock { ["Start Level Offset","End Level Offset"]; }
setParameterByName = Python(IN[0]=beamByCurve_9, IN[1]=code_block_58, IN[2]=code_block_57.offset)  # "Element.SetParameterByName"; CPython3
# ---------- setParameterByName.python (44 lines) ----------
# Load the Python Standard and DesignScript Libraries
import sys
import clr
clr.AddReference('ProtoGeometry')
from Autodesk.DesignScript.Geometry import *

clr.AddReference("RevitNodes")
import Revit

from Revit.Elements import *

clr.AddReference("DSCoreNodes")
from DSCore import *

clr.AddReference('RevitServices')
import RevitServices
from RevitServices.Persistence import DocumentManager
from RevitServices.Transactions import TransactionManager

doc = DocumentManager.Instance.CurrentDBDocument
#TransactionManager.Instance.EnsureInTransaction(doc)

#TransactionManager.Instance.TransactionTaskDone()

# The inputs to this node will be stored as a list in the IN variables.
dataEnteringNode = IN

elements = IN[0]
params = IN[1]
value = IN[2]

# Place your code below this line
TransactionManager.Instance.EnsureInTransaction(doc)
result = []
for i in elements:
    for j in params:
        i.SetParameterByName(j, value)
    result.append(i)

TransactionManager.Instance.TransactionTaskDone()


# Assign your output to the OUT variable.
OUT = result
# ----------------------------------------

code_block_59 = CodeBlock(forBeam=perimeterCurves_2) { forBeam; }
translate_8 = Geometry.Translate(geometry=code_block_59, zTranslation=maximumItem)

# group: 최상층 거더 배치 구간(외곽)
code_block_60 = CodeBlock(segments_out=translate_8, LevelTop=list_lastitem_최상층_찾기, offset=maximumItem) { segments_out; segmentsY_in; LevelTop; offset; }  # unwired: segmentsY_in
flatten_12 = List.Flatten(list=code_block_60.segments_out)
elevation_8 = Level.Elevation(level=code_block_60.LevelTop)
translate_9 = Geometry.Translate(geometry=flatten_12, zTranslation=elevation_8, lacing=CrossProduct)
beamByCurve_10 = StructuralFraming.BeamByCurve(curve=translate_9, level=code_block_60.LevelTop, structuralFramingType=girder_family_types_선택_2, lacing=CrossProduct)

# group: 높이 보정
code_block_61 = CodeBlock { ["Start Level Offset","End Level Offset"]; }
setParameterByName_2 = Python(IN[0]=beamByCurve_10, IN[1]=code_block_61, IN[2]=code_block_60.offset)  # "Element.SetParameterByName"; CPython3; same code as setParameterByName

roof_마감이_있는_룸_객체_선택 = Python(IN[0]=gridDS_4.out3)  # CPython3
# ---------- roof_마감이_있는_룸_객체_선택.python (16 lines) ----------
# Load the Python Standard and DesignScript Libraries
import sys
import clr
clr.AddReference('ProtoGeometry')
from Autodesk.DesignScript.Geometry import *

# The inputs to this node will be stored as a list in the IN variables.
dataEnteringNode = IN

inputs = IN[0]

# Place your code below this line
result = list(filter(lambda i: len(i["rooffinish"])>0, inputs))

# Assign your output to the OUT variable.
OUT = result
# ----------------------------------------
code_block_62 = CodeBlock { "level"; }
valueAtKey_2 = DesignScript.Builtin.Dictionary.ValueAtKey(key=code_block_62)  # unwired: dictionary
groupByFunction_2 = List.GroupByFunction(list=roof_마감이_있는_룸_객체_선택, groupFunction=valueAtKey_2)
code_block_63 = CodeBlock(i=groupByFunction_2) { i["roombottomface"]; }
flatten_13 = List.Flatten(list=code_block_63@L3)
perimeterCurves_3 = Surface.PerimeterCurves(surface=flatten_13)
byJoinedCurves_3 = PolyCurve.ByJoinedCurves(curves=perimeterCurves_3)
code_block_64 = CodeBlock(AllLevels=gridDS_4.out1) { AllLevels; }
string_from_object = FromObject(object=code_block_64)
code_block_65 = CodeBlock(i=groupByFunction_2) { i["level"]; }
uniqueItems = List.UniqueItems(list=code_block_65@L2)
contains = String.Contains(str=string_from_object, searchFor=uniqueItems@L1)
code_block_66 = CodeBlock { true; }
allIndicesOf = List.AllIndicesOf(list=contains@L2, item=code_block_66)
getItemAtIndex = List.GetItemAtIndex(list=code_block_64, index=allIndicesOf)
flatten_14 = List.Flatten(list=getItemAtIndex)
code_block_67 = CodeBlock(i=groupByFunction_2) { i["roomlimitoffset"]; }
maximumItem_2 = List.MaximumItem(list=code_block_67)

# group: 루프 슬라브 배치구간
code_block_68 = CodeBlock(floorcrv=byJoinedCurves_3, Levels_Target=flatten_14, offset=maximumItem_2) { floorcrv; Levels_Target; offset; }
floor_types_선택_2 = FloorTypes("CFS11_Slab RC_T150")  # graph input
byOutlineTypeAndLevel_2 = Floor.ByOutlineTypeAndLevel(outlineCurves=code_block_68.floorcrv@L3, floorType=floor_types_선택_2, level=code_block_68.Levels_Target)

# group: 높이 보정
code_block_69 = CodeBlock(i=byOutlineTypeAndLevel_2) { i[0]; }
code_block_70 = CodeBlock { ["Height Offset From Level"]; }
setParameterByName_3 = Python(IN[0]=code_block_69, IN[1]=code_block_70, IN[2]=code_block_68.offset)  # "Element.SetParameterByName"; CPython3
# ---------- setParameterByName_3.python (47 lines) ----------
# Load the Python Standard and DesignScript Libraries
import sys
import clr
clr.AddReference('ProtoGeometry')
from Autodesk.DesignScript.Geometry import *

clr.AddReference("RevitNodes")
import Revit

from Revit.Elements import *

clr.AddReference("DSCoreNodes")
from DSCore import *

clr.AddReference('RevitServices')
import RevitServices
from RevitServices.Persistence import DocumentManager
from RevitServices.Transactions import TransactionManager

doc = DocumentManager.Instance.CurrentDBDocument
#TransactionManager.Instance.EnsureInTransaction(doc)

#TransactionManager.Instance.TransactionTaskDone()

# The inputs to this node will be stored as a list in the IN variables.
dataEnteringNode = IN

elemGroup = IN[0]
params = IN[1]
values = IN[2]

# Place your code below this line
TransactionManager.Instance.EnsureInTransaction(doc)
result = []
for i in range(len(elemGroup)):
    tmp1 = []
    for j in elemGroup[i]:
        for k in params:
            j.SetParameterByName(k, values[i])
        tmp1.append(j)
    result.append(tmp1)

TransactionManager.Instance.TransactionTaskDone()


# Assign your output to the OUT variable.
OUT = result
# ----------------------------------------

wall_types = WallTypes("WA211_Exterior-Cement Brick-90mm")

# group: 추가 데이터 조작 및 정렬
gridDS_5 = CodeBlock(DataHub=dataHub.DataHub)  # same code as gridDS
code_block_71 = CodeBlock { "level"; }
valueAtKey_3 = DesignScript.Builtin.Dictionary.ValueAtKey(key=code_block_71)  # unwired: dictionary
groupByFunction_3 = List.GroupByFunction(list=gridDS_5.out3, groupFunction=valueAtKey_3)
code_block_72 = CodeBlock(i=groupByFunction_3) { i["surfacedict"]; }
string_from_web_8 = Python()  # CPython3; unwired: IN[0]; same code as string_from_web
boolean_7 = BoolSelector(true)
code_block_73 = CodeBlock { "B"; }
filterelementsexcepttarget_7 = PythonStringNode(script=string_from_web_8, IN[0]=gridDS_5.out1, IN[1]=boolean_7, IN[2]=code_block_73)  # CPython3

code_block_74 = CodeBlock(LevelsExceptB=gridDS_5.out2) { LevelsExceptB; }
code_block_75 = CodeBlock(i=code_block_72) { i["Ext Surfaces"]; }
flatten_15 = List.Flatten(list=code_block_75@L3)
findWallCrvAndLevelOrHeight = Python(IN[0]=flatten_15, IN[1]=code_block_74)  # CPython3
# ---------- findWallCrvAndLevelOrHeight.python (47 lines) ----------
# Load the Python Standard and DesignScript Libraries
import sys
import clr
clr.AddReference('ProtoGeometry')
from Autodesk.DesignScript.Geometry import *

from itertools import chain

# The inputs to this node will be stored as a list in the IN variables.
dataEnteringNode = IN
surfaceGroup = IN[0]
levels = IN[1]

# Place your code below this line

def findWallCrvAndHeight(surface):
    alllines = surface.PerimeterCurves()
    horCrv = list(filter(lambda x: x.Direction.Z==0, alllines))
    verCrv = list(filter(lambda x: x.Direction.Z!=0, alllines))
    height = round(verCrv[0].Length)
    MaxHorCrvZ = max(list(map(lambda y: y.StartPoint.Z, horCrv)))
    wallCrv = list(filter(lambda x: x.StartPoint.Z==MaxHorCrvZ, horCrv))[0]
    
    return (wallCrv, height)

def findWallCrvAndLevel(surface, fromLev, toLev):
    alllines = surface.PerimeterCurves()
    horCrv = list(filter(lambda x: x.Direction.Z==0, alllines))
    verCrv = list(filter(lambda x: x.Direction.Z!=0, alllines))
    height = round(verCrv[0].Length)
    MaxHorCrvZ = max(list(map(lambda y: y.StartPoint.Z, horCrv)))
    wallCrv = list(filter(lambda x: x.StartPoint.Z==MaxHorCrvZ, horCrv))[0]
    
    return (wallCrv, fromLev, toLev)

result = []
for i in range(len(surfaceGroup)):
    tmp = []
    for surface in surfaceGroup[i]:
        if i < len(surfaceGroup)-1:
            tmp.append(findWallCrvAndLevel(surface, levels[i], levels[i+1]))
        else:
            tmp.append(findWallCrvAndHeight(surface))
    result.append(tmp)
    
# Assign your output to the OUT variable.
OUT = result
# ----------------------------------------
byCurveAndHeightOrLevel = Python(IN[0]=wall_types, IN[1]=code_block_74, IN[2]=findWallCrvAndLevelOrHeight)  # "Wall.ByCurveAndHeightOrLevel"; CPython3
# ---------- byCurveAndHeightOrLevel.python (48 lines) ----------
# Load the Python Standard and DesignScript Libraries
import sys
import clr
clr.AddReference('ProtoGeometry')
from Autodesk.DesignScript.Geometry import *

clr.AddReference("RevitNodes")
import Revit

from Revit.Elements import *

clr.AddReference("DSCoreNodes")
from DSCore import *

clr.AddReference('RevitServices')
import RevitServices
from RevitServices.Persistence import DocumentManager
from RevitServices.Transactions import TransactionManager

doc = DocumentManager.Instance.CurrentDBDocument

# The inputs to this node will be stored as a list in the IN variables.
dataEnteringNode = IN
wallType = IN[0]
levels = IN[1]
linesGroupByLevel = IN[2]

# Place your code below this line
result = []
for i in range(len(linesGroupByLevel)):
    tmp = []
    for j in linesGroupByLevel[i]:
        if len(j) < 3:
            crv = j[0]
            height = j[1]
            level = levels[i]
            wall = Wall.ByCurveAndHeight(crv, height, level, wallType)
            tmp.append(wall)
        else:
            crv = j[0]
            sttLevel = j[1]
            endLevel = j[2]
            wall = Wall.ByCurveAndLevels(crv, sttLevel, endLevel, wallType)
            tmp.append(wall)
    result.append(tmp)

# Assign your output to the OUT variable.
OUT = result
# ----------------------------------------
wall_types_2 = WallTypes("WA221_Interior-Cement Block-190mm")
code_block_76 = CodeBlock(i=code_block_72) { i["Int Surfaces"]; }

# group (continued): 추가 데이터 조작 및 정렬
flatten_16 = List.Flatten(list=code_block_76@L3)

findUniqueSrf = Python(IN[0]=flatten_16)  # CPython3
# ---------- findUniqueSrf.python (54 lines) ----------
# Load the Python Standard and DesignScript Libraries
import sys
import clr
clr.AddReference('ProtoGeometry')
from Autodesk.DesignScript.Geometry import *

# The inputs to this node will be stored as a list in the IN variables.
dataEnteringNode = IN
surfaceGroup = IN[0]

# Place your code below this line

def findUniqueSrf(surfaces):
    def findintscsurfaces(surfaces):
        final = []
        idx_log = []
        
        for i in surfaces:
            tmp = []
            idx = surfaces.index(i)
            if idx in idx_log:
                pass
            else:
                for j in surfaces:
                    target = i
                    target_bdry = PolyCurve.ByJoinedCurves(target.PerimeterCurves())
                    targetsrf = Surface.ByPatch(target_bdry.Offset(-10))
                    if targetsrf.DoesIntersect(j):
                        tmp.append(j)
                        idx_log.append(surfaces.index(j))
                    else:
                        pass
            final.append(tmp)
        result = list(filter(lambda i: len(i)>0, final))
        return result
    
    duplicatedlist = findintscsurfaces(surfaces)
    
    result = []
            
    for i in duplicatedlist:
        arealist = list(map( lambda x: x.Area, i))
        maxval = max(arealist)
        idx = arealist.index(maxval)
        result.append(i[idx])
        
    return result

result = []
for surfaces in surfaceGroup:
    tmp = findUniqueSrf(surfaces)
    result.append(tmp)
# Assign your output to the OUT variable.
OUT = result
# ----------------------------------------
findWallCrvAndheight = Python(IN[0]=findUniqueSrf)  # CPython3
# ---------- findWallCrvAndheight.python (33 lines) ----------
# Load the Python Standard and DesignScript Libraries
import sys
import clr
clr.AddReference('ProtoGeometry')
from Autodesk.DesignScript.Geometry import *

from itertools import chain

# The inputs to this node will be stored as a list in the IN variables.
dataEnteringNode = IN
surfaceGroup = IN[0]

# Place your code below this line

def findWallCrvAndHeight(surface):
    alllines = surface.PerimeterCurves()
    horCrv = list(filter(lambda x: x.Direction.Z==0, alllines))
    verCrv = list(filter(lambda x: x.Direction.Z!=0, alllines))
    height = round(verCrv[0].Length)
    MaxHorCrvZ = max(list(map(lambda y: y.StartPoint.Z, horCrv)))
    wallCrv = list(filter(lambda x: x.StartPoint.Z==MaxHorCrvZ, horCrv))[0]
    
    return (wallCrv, height)

result = []
for i in surfaceGroup:
    tmp = []
    for surface in i:
        tmp.append(findWallCrvAndHeight(surface))
    result.append(tmp)
    
# Assign your output to the OUT variable.
OUT = result
# ----------------------------------------
byCurveAndHeight = Python(IN[0]=wall_types_2, IN[1]=code_block_74, IN[2]=findWallCrvAndheight)  # "Wall.ByCurveAndHeight"; CPython3
# ---------- byCurveAndHeight.python (41 lines) ----------
# Load the Python Standard and DesignScript Libraries
import sys
import clr
clr.AddReference('ProtoGeometry')
from Autodesk.DesignScript.Geometry import *

clr.AddReference("RevitNodes")
import Revit

from Revit.Elements import *

clr.AddReference("DSCoreNodes")
from DSCore import *

clr.AddReference('RevitServices')
import RevitServices
from RevitServices.Persistence import DocumentManager
from RevitServices.Transactions import TransactionManager

doc = DocumentManager.Instance.CurrentDBDocument

# The inputs to this node will be stored as a list in the IN variables.
dataEnteringNode = IN
wallType = IN[0]
levels = IN[1]
linesGroupByLevel = IN[2]

# Place your code below this line
result = []
for i in range(len(linesGroupByLevel)):
    tmp = []
    for j in linesGroupByLevel[i]:
        crv = j[0]
        height = j[1]
        level = levels[i]
        wall = Wall.ByCurveAndHeight(crv, height, level, wallType)
        tmp.append(wall)
    result.append(tmp)

# Assign your output to the OUT variable.
OUT = result
# ----------------------------------------
code_block_77 = CodeBlock(i=groupByFunction_3) { i["level"]; }
