# Dynamo graph 4_Bidding Quantity Calculation(0104).dyn (Dynamo 2.12.0.5650)

# group: Input for Calculation
skirt_height = DoubleInput(100)
wet_area_waterproofing_height = DoubleInput(1500)
chemical_acid_area_resist_height = DoubleInput(1500)

# group: Filtering Level(Room 배치 대상 레벨)
string_from_web = Python()  # CPython3; unwired: IN[0]
# ---------- string_from_web.python (19 lines) ----------
# Load the Python Standard and DesignScript Libraries
import sys
import clr
clr.AddReference('ProtoGeometry')
from Autodesk.DesignScript.Geometry import *
import urllib.request

# The inputs to this node will be stored as a list in the IN variables.
dataEnteringNode = IN
inputURL = "https://raw.githubusercontent.com/HNANmal/mQ/master/Hdynlib/Revit/Elements/Filtering/FilterElementsExceptTarget.py"

# Place your code below this line
req = urllib.request
data = req.urlopen(inputURL)

result = data.read().decode("utf-8")

# Assign your output to the OUT variable.
OUT = result
# ----------------------------------------
categories = Categories("OST_Levels")
all_elements_of_category = ElementsOfCategory(Category=categories)
지하층_포함여부 = BoolSelector(false)  # graph input
code_block = CodeBlock { "B"; }
selectallelementsexcept = PythonStringNode(script=string_from_web, IN[0]=all_elements_of_category, IN[1]=지하층_포함여부, IN[2]=code_block)  # CPython3

# group: All Room Elements
categories_2 = Categories("OST_Rooms")
all_elements_of_category_2 = ElementsOfCategory(Category=categories_2)

# group: Create RoomDS
string_from_web_2 = Python()  # CPython3; unwired: IN[0]
# ---------- string_from_web_2.python (19 lines) ----------
# Load the Python Standard and DesignScript Libraries
import sys
import clr
clr.AddReference('ProtoGeometry')
from Autodesk.DesignScript.Geometry import *
import urllib.request

# The inputs to this node will be stored as a list in the IN variables.
dataEnteringNode = IN
inputURL = "https://raw.githubusercontent.com/HNANmal/mQ/master/Hdynlib/DataStructure/Custom/Rooms/CreateRoomDS.py"

# Place your code below this line
req = urllib.request
data = req.urlopen(inputURL)

result = data.read().decode("utf-8")

# Assign your output to the OUT variable.
OUT = result
# ----------------------------------------
createroomds = PythonStringNode(script=string_from_web_2, IN[0]=selectallelementsexcept, IN[1]=all_elements_of_category_2)  # CPython3
roomDS_objects = CodeBlock(result=createroomds) { result; }

# group: Input_Excel related
file_path = Filename(".\01_Building List_Pilot Project_2021_1211_mk.xlsx")  # graph input
sheet_name = CodeBlock { "Finish Code"; }

# group: Github_Python@Import Excel(By OpenpyXl)
string_from_web_3 = Python()  # CPython3; unwired: IN[0]
# ---------- string_from_web_3.python (19 lines) ----------
# Load the Python Standard and DesignScript Libraries
import sys
import clr
clr.AddReference('ProtoGeometry')
from Autodesk.DesignScript.Geometry import *
import urllib.request

# The inputs to this node will be stored as a list in the IN variables.
dataEnteringNode = IN
inputURL = "https://raw.githubusercontent.com/HNANmal/mQ/master/Laboratory/20211123_%EC%9E%85%EC%B0%B0%EC%9E%90%EB%8F%99%ED%99%94%ED%88%B4Test%20Sample/test.py"

# Place your code below this line
req = urllib.request
data = req.urlopen(inputURL)

result = data.read().decode("utf-8")

# Assign your output to the OUT variable.
OUT = result
# ----------------------------------------
python_script_from_string = PythonStringNode(script=string_from_web_3, IN[0]=file_path, IN[1]=sheet_name)  # CPython3

# group: Data bunch 분할_Row기반
code_block_2 = CodeBlock { 2; }
dropItems = List.DropItems(list=python_script_from_string, amount=code_block_2)
string_from_object = FromObject(object=dropItems)
firstItem = List.FirstItem(list=string_from_object@L2)
code_block_3 = CodeBlock { "Base Material"; }
contains = String.Contains(string=firstItem, searchFor=code_block_3)
code_block_4 = CodeBlock { true; }
allIndicesOf = List.AllIndicesOf(list=contains, item=code_block_4)
python_script_data_bunch_분할_행기반 = Python(IN[0]=allIndicesOf)  # CPython3
# ---------- python_script_data_bunch_분할_행기반.python (22 lines) ----------
# Load the Python Standard and DesignScript Libraries
import sys
import clr
clr.AddReference('ProtoGeometry')
from Autodesk.DesignScript.Geometry import *

# The inputs to this node will be stored as a list in the IN variables.
dataEnteringNode = IN
inlist = IN[0]

# Place your code below this line
result = []
for i in range(len(inlist)):
    if i < len(inlist)-1:
        sub = inlist[i+1] - inlist[i]
        result.append(sub)
    else:
        pass


# Assign your output to the OUT variable.
OUT = result
# ----------------------------------------
chop = List.Chop(list=dropItems, lengths=python_script_data_bunch_분할_행기반)

# group: 마감 종류별 Dictionary 정리- Roof, Wall, Base, Floor, Ceiling
code_block_5 = CodeBlock { 1; }
getItemAtIndex = List.GetItemAtIndex(list=chop@L3, index=code_block_5)
firstItem_2 = List.FirstItem(list=getItemAtIndex@L2)
byKeysValues = DesignScript.Builtin.Dictionary.ByKeysValues(keys=firstItem_2, values=chop)

# group: Finish Type 코드가 있는 Column 인덱스 추출
firstItem_3 = List.FirstItem(list=chop@L3)
code_block_6 = CodeBlock { "Finish"; }
eq = firstItem_3 == code_block_6
code_block_7 = CodeBlock { true; }
allIndicesOf_2 = List.AllIndicesOf(list=eq@L2, item=code_block_7)
flatten = List.Flatten(list=allIndicesOf_2)
uniqueItems = List.UniqueItems(list=flatten)
code_block_8 = CodeBlock(i=uniqueItems) { i[0]; }

code_block_9 = CodeBlock { "Roof"; "RF"; }

# group: Type 별 WM 추출 - Roof
code_block_10 = CodeBlock(TypeDictionary=byKeysValues, FinishCodeIndex=code_block_8, FinishType=code_block_9.out0, FinishTypeMark=code_block_9.out1)
# ---------- code_block_10.designscript (10 lines) ----------
i={
"TypeDictionary": TypeDictionary,
"FinishCodeIndex": FinishCodeIndex,
"FinishType": FinishType,
"FinishTypeMark": FinishTypeMark
};
i["TypeDictionary"];
i["FinishCodeIndex"];
i["FinishType"];
i["FinishTypeMark"];
# ----------------------------------------
valueAtKey = DesignScript.Builtin.Dictionary.ValueAtKey(dictionary=code_block_10.out1, key=code_block_10.out3)
getItemAtIndex_2 = List.GetItemAtIndex(list=valueAtKey@L2, index=code_block_10.out2)
contains_2 = String.Contains(string=getItemAtIndex_2, searchFor=code_block_10.out4)
code_block_11 = CodeBlock { true; }
allIndicesOf_3 = List.AllIndicesOf(list=contains_2, item=code_block_11)
getItemAtIndex_3 = List.GetItemAtIndex(list=valueAtKey@L3, index=allIndicesOf_3)
code_block_12 = CodeBlock(i=code_block_10.out2) { i; }
dropItems_2 = List.DropItems(list=getItemAtIndex_3@L2, amount=code_block_12)
firstItem_4 = List.FirstItem(list=dropItems_2@L2)
string_from_object_2 = FromObject(object=dropItems_2)
code_block_13 = CodeBlock { "O"; }
allIndicesOf_4 = List.AllIndicesOf(list=string_from_object_2@L2, item=code_block_13)
python_script_empty_list_indices = Python(IN[0]=allIndicesOf_4)  # CPython3
# ---------- python_script_empty_list_indices.python (19 lines) ----------
# Load the Python Standard and DesignScript Libraries
import sys
import clr
clr.AddReference('ProtoGeometry')
from Autodesk.DesignScript.Geometry import *

# The inputs to this node will be stored as a list in the IN variables.
dataEnteringNode = IN

inlist = IN[0]
# Place your code below this line
result = []
for i in range(len(inlist)):
    if inlist[i]:
        pass
    else:
        result.append(i)
# Assign your output to the OUT variable.
OUT = result
# ----------------------------------------
removeItemAtIndex = List.RemoveItemAtIndex(list=firstItem_4, indices=python_script_empty_list_indices)
code_block_14 = CodeBlock { 2; }
getItemAtIndex_4 = List.GetItemAtIndex(list=valueAtKey@L3, index=code_block_14)
dropItems_3 = List.DropItems(list=getItemAtIndex_4@L2, amount=code_block_12)
flatten_2 = List.Flatten(list=dropItems_3)
python_script_empty_list_제거 = Python(IN[0]=allIndicesOf_4)  # CPython3
# ---------- python_script_empty_list_제거.python (19 lines) ----------
# Load the Python Standard and DesignScript Libraries
import sys
import clr
clr.AddReference('ProtoGeometry')
from Autodesk.DesignScript.Geometry import *

# The inputs to this node will be stored as a list in the IN variables.
dataEnteringNode = IN

inlist = IN[0]
# Place your code below this line
result = []
for i in inlist:
    if i:
        result.append(i)
    else:
        pass
# Assign your output to the OUT variable.
OUT = result
# ----------------------------------------
getItemAtIndex_5 = List.GetItemAtIndex(list=flatten_2, index=python_script_empty_list_제거@L2)
code_block_15 = CodeBlock { 1; }
getItemAtIndex_6 = List.GetItemAtIndex(list=valueAtKey@L3, index=code_block_15)
dropItems_4 = List.DropItems(list=getItemAtIndex_6@L2, amount=code_block_12)
flatten_3 = List.Flatten(list=dropItems_4)
getItemAtIndex_7 = List.GetItemAtIndex(list=flatten_3, index=python_script_empty_list_제거@L2)
code_block_16 = CodeBlock(a=getItemAtIndex_5, b=getItemAtIndex_7) { a+": "+b; }
byKeysValues_2 = DesignScript.Builtin.Dictionary.ByKeysValues(keys=removeItemAtIndex, values=code_block_16)

code_block_17 = CodeBlock { "Exterior Wall"; "EW"; }

# group: Type 별 WM 추출 - Exterior Wall
code_block_18 = CodeBlock(TypeDictionary=byKeysValues, FinishCodeIndex=code_block_8, FinishType=code_block_17.out0, FinishTypeMark=code_block_17.out1)  # same code as code_block_10
valueAtKey_2 = DesignScript.Builtin.Dictionary.ValueAtKey(dictionary=code_block_18.out1, key=code_block_18.out3)
getItemAtIndex_8 = List.GetItemAtIndex(list=valueAtKey_2@L2, index=code_block_18.out2)
contains_3 = String.Contains(string=getItemAtIndex_8, searchFor=code_block_18.out4)
code_block_19 = CodeBlock { true; }
allIndicesOf_5 = List.AllIndicesOf(list=contains_3, item=code_block_19)
getItemAtIndex_9 = List.GetItemAtIndex(list=valueAtKey_2@L3, index=allIndicesOf_5)
code_block_20 = CodeBlock(i=code_block_18.out2) { i; }
dropItems_5 = List.DropItems(list=getItemAtIndex_9@L2, amount=code_block_20)
firstItem_5 = List.FirstItem(list=dropItems_5@L2)
string_from_object_3 = FromObject(object=dropItems_5)
code_block_21 = CodeBlock { "O"; }
allIndicesOf_6 = List.AllIndicesOf(list=string_from_object_3@L2, item=code_block_21)
python_script_empty_list_indices_2 = Python(IN[0]=allIndicesOf_6)  # CPython3; same code as python_script_empty_list_indices
removeItemAtIndex_2 = List.RemoveItemAtIndex(list=firstItem_5, indices=python_script_empty_list_indices_2)
code_block_22 = CodeBlock { 2; }
getItemAtIndex_10 = List.GetItemAtIndex(list=valueAtKey_2@L3, index=code_block_22)
dropItems_6 = List.DropItems(list=getItemAtIndex_10@L2, amount=code_block_20)
flatten_4 = List.Flatten(list=dropItems_6)
python_script_empty_list_제거_2 = Python(IN[0]=allIndicesOf_6)  # CPython3; same code as python_script_empty_list_제거
getItemAtIndex_11 = List.GetItemAtIndex(list=flatten_4, index=python_script_empty_list_제거_2@L2)
code_block_23 = CodeBlock { 1; }
getItemAtIndex_12 = List.GetItemAtIndex(list=valueAtKey_2@L3, index=code_block_23)
dropItems_7 = List.DropItems(list=getItemAtIndex_12@L2, amount=code_block_20)
flatten_5 = List.Flatten(list=dropItems_7)
getItemAtIndex_13 = List.GetItemAtIndex(list=flatten_5, index=python_script_empty_list_제거_2@L2)
code_block_24 = CodeBlock(a=getItemAtIndex_11, b=getItemAtIndex_13) { a+": "+b; }
byKeysValues_3 = DesignScript.Builtin.Dictionary.ByKeysValues(keys=removeItemAtIndex_2, values=code_block_24)

code_block_25 = CodeBlock { "Interior Wall"; "IW"; }

# group: Type 별 WM 추출 - Interior Wall
code_block_26 = CodeBlock(TypeDictionary=byKeysValues, FinishCodeIndex=code_block_8, FinishType=code_block_25.out0, FinishTypeMark=code_block_25.out1)  # same code as code_block_10
valueAtKey_3 = DesignScript.Builtin.Dictionary.ValueAtKey(dictionary=code_block_26.out1, key=code_block_26.out3)
getItemAtIndex_14 = List.GetItemAtIndex(list=valueAtKey_3@L2, index=code_block_26.out2)
contains_4 = String.Contains(string=getItemAtIndex_14, searchFor=code_block_26.out4)
code_block_27 = CodeBlock { true; }
allIndicesOf_7 = List.AllIndicesOf(list=contains_4, item=code_block_27)
getItemAtIndex_15 = List.GetItemAtIndex(list=valueAtKey_3@L3, index=allIndicesOf_7)
code_block_28 = CodeBlock(i=code_block_26.out2) { i; }
dropItems_8 = List.DropItems(list=getItemAtIndex_15@L2, amount=code_block_28)
firstItem_6 = List.FirstItem(list=dropItems_8@L2)
string_from_object_4 = FromObject(object=dropItems_8)
code_block_29 = CodeBlock { "O"; }
allIndicesOf_8 = List.AllIndicesOf(list=string_from_object_4@L2, item=code_block_29)
python_script_empty_list_indices_3 = Python(IN[0]=allIndicesOf_8)  # CPython3; same code as python_script_empty_list_indices
removeItemAtIndex_3 = List.RemoveItemAtIndex(list=firstItem_6, indices=python_script_empty_list_indices_3)
code_block_30 = CodeBlock { 2; }
getItemAtIndex_16 = List.GetItemAtIndex(list=valueAtKey_3@L3, index=code_block_30)
dropItems_9 = List.DropItems(list=getItemAtIndex_16@L2, amount=code_block_28)
flatten_6 = List.Flatten(list=dropItems_9)
python_script_empty_list_제거_3 = Python(IN[0]=allIndicesOf_8)  # CPython3; same code as python_script_empty_list_제거
getItemAtIndex_17 = List.GetItemAtIndex(list=flatten_6, index=python_script_empty_list_제거_3@L2)
code_block_31 = CodeBlock { 1; }
getItemAtIndex_18 = List.GetItemAtIndex(list=valueAtKey_3@L3, index=code_block_31)
dropItems_10 = List.DropItems(list=getItemAtIndex_18@L2, amount=code_block_28)
flatten_7 = List.Flatten(list=dropItems_10)
getItemAtIndex_19 = List.GetItemAtIndex(list=flatten_7, index=python_script_empty_list_제거_3@L2)
code_block_32 = CodeBlock(a=getItemAtIndex_17, b=getItemAtIndex_19) { a+": "+b; }
byKeysValues_4 = DesignScript.Builtin.Dictionary.ByKeysValues(keys=removeItemAtIndex_3, values=code_block_32)

code_block_33 = CodeBlock { "Interior Base"; "WK"; }

# group: Type 별 WM 추출 - Interior Base
code_block_34 = CodeBlock(TypeDictionary=byKeysValues, FinishCodeIndex=code_block_8, FinishType=code_block_33.out0, FinishTypeMark=code_block_33.out1)  # same code as code_block_10
valueAtKey_4 = DesignScript.Builtin.Dictionary.ValueAtKey(dictionary=code_block_34.out1, key=code_block_34.out3)
getItemAtIndex_20 = List.GetItemAtIndex(list=valueAtKey_4@L2, index=code_block_34.out2)
contains_5 = String.Contains(string=getItemAtIndex_20, searchFor=code_block_34.out4)
code_block_35 = CodeBlock { true; }
allIndicesOf_9 = List.AllIndicesOf(list=contains_5, item=code_block_35)
getItemAtIndex_21 = List.GetItemAtIndex(list=valueAtKey_4@L3, index=allIndicesOf_9)
code_block_36 = CodeBlock(i=code_block_34.out2) { i; }
dropItems_11 = List.DropItems(list=getItemAtIndex_21@L2, amount=code_block_36)
firstItem_7 = List.FirstItem(list=dropItems_11@L2)
string_from_object_5 = FromObject(object=dropItems_11)
code_block_37 = CodeBlock { "O"; }
allIndicesOf_10 = List.AllIndicesOf(list=string_from_object_5@L2, item=code_block_37)
python_script_empty_list_indices_4 = Python(IN[0]=allIndicesOf_10)  # CPython3; same code as python_script_empty_list_indices
removeItemAtIndex_4 = List.RemoveItemAtIndex(list=firstItem_7, indices=python_script_empty_list_indices_4)
code_block_38 = CodeBlock { 2; }
getItemAtIndex_22 = List.GetItemAtIndex(list=valueAtKey_4@L3, index=code_block_38)
dropItems_12 = List.DropItems(list=getItemAtIndex_22@L2, amount=code_block_36)
flatten_8 = List.Flatten(list=dropItems_12)
python_script_empty_list_제거_4 = Python(IN[0]=allIndicesOf_10)  # CPython3; same code as python_script_empty_list_제거
getItemAtIndex_23 = List.GetItemAtIndex(list=flatten_8, index=python_script_empty_list_제거_4@L2)
code_block_39 = CodeBlock { 1; }
getItemAtIndex_24 = List.GetItemAtIndex(list=valueAtKey_4@L3, index=code_block_39)
dropItems_13 = List.DropItems(list=getItemAtIndex_24@L2, amount=code_block_36)
flatten_9 = List.Flatten(list=dropItems_13)
getItemAtIndex_25 = List.GetItemAtIndex(list=flatten_9, index=python_script_empty_list_제거_4@L2)
code_block_40 = CodeBlock(a=getItemAtIndex_23, b=getItemAtIndex_25) { a+": "+b; }
byKeysValues_5 = DesignScript.Builtin.Dictionary.ByKeysValues(keys=removeItemAtIndex_4, values=code_block_40)

code_block_41 = CodeBlock { "Interior Floor"; "FL"; }

# group: Type 별 WM 추출 - Interior Floor
code_block_42 = CodeBlock(TypeDictionary=byKeysValues, FinishCodeIndex=code_block_8, FinishType=code_block_41.out0, FinishTypeMark=code_block_41.out1)  # same code as code_block_10
valueAtKey_5 = DesignScript.Builtin.Dictionary.ValueAtKey(dictionary=code_block_42.out1, key=code_block_42.out3)
getItemAtIndex_26 = List.GetItemAtIndex(list=valueAtKey_5@L2, index=code_block_42.out2)
contains_6 = String.Contains(string=getItemAtIndex_26, searchFor=code_block_42.out4)
code_block_43 = CodeBlock { true; }
allIndicesOf_11 = List.AllIndicesOf(list=contains_6, item=code_block_43)
getItemAtIndex_27 = List.GetItemAtIndex(list=valueAtKey_5@L3, index=allIndicesOf_11)
code_block_44 = CodeBlock(i=code_block_42.out2) { i; }
dropItems_14 = List.DropItems(list=getItemAtIndex_27@L2, amount=code_block_44)
firstItem_8 = List.FirstItem(list=dropItems_14@L2)
string_from_object_6 = FromObject(object=dropItems_14)
code_block_45 = CodeBlock { "O"; }
allIndicesOf_12 = List.AllIndicesOf(list=string_from_object_6@L2, item=code_block_45)
python_script_empty_list_indices_5 = Python(IN[0]=allIndicesOf_12)  # CPython3; same code as python_script_empty_list_indices
removeItemAtIndex_5 = List.RemoveItemAtIndex(list=firstItem_8, indices=python_script_empty_list_indices_5)
code_block_46 = CodeBlock { 2; }
getItemAtIndex_28 = List.GetItemAtIndex(list=valueAtKey_5@L3, index=code_block_46)
dropItems_15 = List.DropItems(list=getItemAtIndex_28@L2, amount=code_block_44)
flatten_10 = List.Flatten(list=dropItems_15)
python_script_empty_list_제거_5 = Python(IN[0]=allIndicesOf_12)  # CPython3; same code as python_script_empty_list_제거
getItemAtIndex_29 = List.GetItemAtIndex(list=flatten_10, index=python_script_empty_list_제거_5@L2)
code_block_47 = CodeBlock { 1; }
getItemAtIndex_30 = List.GetItemAtIndex(list=valueAtKey_5@L3, index=code_block_47)
dropItems_16 = List.DropItems(list=getItemAtIndex_30@L2, amount=code_block_44)
flatten_11 = List.Flatten(list=dropItems_16)
getItemAtIndex_31 = List.GetItemAtIndex(list=flatten_11, index=python_script_empty_list_제거_5@L2)
code_block_48 = CodeBlock(a=getItemAtIndex_29, b=getItemAtIndex_31) { a+": "+b; }
byKeysValues_6 = DesignScript.Builtin.Dictionary.ByKeysValues(keys=removeItemAtIndex_5, values=code_block_48)

code_block_49 = CodeBlock { "Interior Ceiling"; "CL"; }

# group: Type 별 WM 추출 - Interior Ceiling
code_block_50 = CodeBlock(TypeDictionary=byKeysValues, FinishCodeIndex=code_block_8, FinishType=code_block_49.out0, FinishTypeMark=code_block_49.out1)  # same code as code_block_10
valueAtKey_6 = DesignScript.Builtin.Dictionary.ValueAtKey(dictionary=code_block_50.out1, key=code_block_50.out3)
getItemAtIndex_32 = List.GetItemAtIndex(list=valueAtKey_6@L2, index=code_block_50.out2)
contains_7 = String.Contains(string=getItemAtIndex_32, searchFor=code_block_50.out4)
code_block_51 = CodeBlock { true; }
allIndicesOf_13 = List.AllIndicesOf(list=contains_7, item=code_block_51)
getItemAtIndex_33 = List.GetItemAtIndex(list=valueAtKey_6@L3, index=allIndicesOf_13)
code_block_52 = CodeBlock(i=code_block_50.out2) { i; }
dropItems_17 = List.DropItems(list=getItemAtIndex_33@L2, amount=code_block_52)
firstItem_9 = List.FirstItem(list=dropItems_17@L2)
string_from_object_7 = FromObject(object=dropItems_17)
code_block_53 = CodeBlock { "O"; }
allIndicesOf_14 = List.AllIndicesOf(list=string_from_object_7@L2, item=code_block_53)
python_script_empty_list_indices_6 = Python(IN[0]=allIndicesOf_14)  # CPython3; same code as python_script_empty_list_indices
removeItemAtIndex_6 = List.RemoveItemAtIndex(list=firstItem_9, indices=python_script_empty_list_indices_6)
code_block_54 = CodeBlock { 2; }
getItemAtIndex_34 = List.GetItemAtIndex(list=valueAtKey_6@L3, index=code_block_54)
dropItems_18 = List.DropItems(list=getItemAtIndex_34@L2, amount=code_block_52)
flatten_12 = List.Flatten(list=dropItems_18)
python_script_empty_list_제거_6 = Python(IN[0]=allIndicesOf_14)  # CPython3; same code as python_script_empty_list_제거
getItemAtIndex_35 = List.GetItemAtIndex(list=flatten_12, index=python_script_empty_list_제거_6@L2)
code_block_55 = CodeBlock { 1; }
getItemAtIndex_36 = List.GetItemAtIndex(list=valueAtKey_6@L3, index=code_block_55)
dropItems_19 = List.DropItems(list=getItemAtIndex_36@L2, amount=code_block_52)
flatten_13 = List.Flatten(list=dropItems_19)
getItemAtIndex_37 = List.GetItemAtIndex(list=flatten_13, index=python_script_empty_list_제거_6@L2)
code_block_56 = CodeBlock(a=getItemAtIndex_35, b=getItemAtIndex_37) { a+": "+b; }
byKeysValues_7 = DesignScript.Builtin.Dictionary.ByKeysValues(keys=removeItemAtIndex_6, values=code_block_56)

# group: Merge FinishType Dicts
python_script = Python()  # CPython3; unwired: IN[0]
# ---------- python_script.python (19 lines) ----------
# Load the Python Standard and DesignScript Libraries
import sys
import clr
clr.AddReference('ProtoGeometry')
from Autodesk.DesignScript.Geometry import *
import urllib.request

# The inputs to this node will be stored as a list in the IN variables.
dataEnteringNode = IN
inputURL = "https://raw.githubusercontent.com/HNANmal/mQ/master/Hdynlib/DataStructure/Dictionary/MergeDictionary.py"

# Place your code below this line
req = urllib.request
data = req.urlopen(inputURL)

result = data.read().decode("utf-8")

# Assign your output to the OUT variable.
OUT = result
# ----------------------------------------
join = List.Join(list0=byKeysValues_2, list1=byKeysValues_3, list2=byKeysValues_4, list3=byKeysValues_5, list4=byKeysValues_6, list5=byKeysValues_7)
merge_dictionary = PythonStringNode(script=python_script, IN[0]=join)  # CPython3

# group: Create SettingsDS
settingsDS = Python(IN[0]=roomDS_objects, IN[1]=merge_dictionary)  # CPython3
# ---------- settingsDS.python (101 lines) ----------
# Load the Python Standard and DesignScript Libraries
import sys
import clr
clr.AddReference('ProtoGeometry')
from Autodesk.DesignScript.Geometry import *

from itertools import chain

# The inputs to this node will be stored as a list in the IN variables.
dataEnteringNode = IN
inputs = IN[0]
wmdict = IN[1]
    

# Place your code below this line
def main():

    def Create_SettingsDS(roomDS, wmdict):
        def find_WM(finishtype, wmdict):
            result = []
            #result = {}
            if finishtype:
                if finishtype[0] =="":
                    pass
                else:
                    if "WK" in str(finishtype):
                        #result = list(map(lambda x: {"base": wmdict[x]}, finishtype))
                        result = [wmdict[x] for x in finishtype]
                    elif "CL" in str(finishtype):
                        #result = list(map(lambda x: {"ceil": wmdict[x]}, finishtype))
                        result = [wmdict[x] for x in finishtype]
                    elif "IW" in str(finishtype):
                        #result = list(map(lambda x: {"wall": wmdict[x]}, finishtype))
                        result = [wmdict[x] for x in finishtype]
                    elif "FL" in str(finishtype):
                        #result = list(map(lambda x: {"floor": wmdict[x]}, finishtype))
                        result = [wmdict[x] for x in finishtype]
                    elif "RF" in str(finishtype):
                        #result = list(map(lambda x: {"roof": wmdict[x]}, finishtype))
                        result = [wmdict[x] for x in finishtype]
                    elif "EW" in str(finishtype):
                        #result = list(map(lambda x: {"extwall": wmdict[x]}, finishtype))
                        result = [wmdict[x] for x in finishtype]
            else:
                result = []
            return result
            
        name = roomDS["name"]
        roomDS = roomDS
        _baseWM = find_WM(roomDS["basefinish"], wmdict)
        if _baseWM:
            baseWM = _baseWM[0]
        else:
            baseWM = []
        _ceilWM = find_WM(roomDS["ceilfinish"], wmdict)
        if _ceilWM:
            ceilWM = _ceilWM[0]
        else:
            ceilWM = []
        _wallWM = find_WM(roomDS["wallfinish"], wmdict)
        if _wallWM:
            wallWM = _wallWM[0]
        else:
            wallWM = []
        _floorWM = find_WM(roomDS["floorfinish"], wmdict)
        if _floorWM:
            floorWM = _floorWM[0]
        else:
            floorWM = []
        _roofWM = find_WM(roomDS["rooffinish"], wmdict)
        if _roofWM:
            roofWM = _roofWM[0]
        else:
            roofWM = []
        _extwallWM = find_WM(roomDS["extwallfinish"], wmdict)
        if _extwallWM:
            extwallWM = _extwallWM[0]
        else:
            extwallWM = []
        
        result = {
            "name": name,
            "roomDS": roomDS,
            "baseWM": baseWM,
            "ceilWM": ceilWM,
            "wallWM": wallWM,
            "floorWM": floorWM,
            "roofWM": roofWM,
            "extwallWM": extwallWM
        }
        
        return result
        
        
    SettingsDS = [Create_SettingsDS(x, wmdict) for x in inputs]
    
    result = SettingsDS
    return result

# Assign your output to the OUT variable.
OUT = main()
# ----------------------------------------

categories_3 = Categories("OST_Walls")
all_elements_of_category_3 = ElementsOfCategory(Category=categories_3)
gettargetforbase = Python()  # CPython3; unwired: IN[0]
# ---------- gettargetforbase.python (22 lines) ----------
# Load the Python Standard and DesignScript Libraries
import sys
import clr
clr.AddReference('ProtoGeometry')
from Autodesk.DesignScript.Geometry import *

# The inputs to this node will be stored as a list in the IN variables.
dataEnteringNode = IN

# Place your code below this line
def getTargetforBase(SettingsDS, WM):
    targets = []
    
    if "Something" in WM:
        pass
    else:
        targets = SettingsDS["roomDS"]["roomperimeter"]
#    targets = SettingsDS["roomDS"]["roomperimeter"]

    return targets
# Assign your output to the OUT variable.
OUT = getTargetforBase
# ----------------------------------------
gettargetforceil = Python()  # CPython3; unwired: IN[0]
# ---------- gettargetforceil.python (21 lines) ----------
# Load the Python Standard and DesignScript Libraries
import sys
import clr
clr.AddReference('ProtoGeometry')
from Autodesk.DesignScript.Geometry import *

# The inputs to this node will be stored as a list in the IN variables.
dataEnteringNode = IN

# Place your code below this line
def getTargetforCeil(SettingsDS, WM):
    targets = []
    
    if "Something" in WM:
        pass
    else:
        targets = SettingsDS["roomDS"]["roomupperface"]

    return targets
# Assign your output to the OUT variable.
OUT = getTargetforCeil
# ----------------------------------------
gettargetforwall = Python()  # CPython3; unwired: IN[0], IN[1]
# ---------- gettargetforwall.python (43 lines) ----------
# Load the Python Standard and DesignScript Libraries
import sys
import clr
clr.AddReference('ProtoGeometry')
from Autodesk.DesignScript.Geometry import *

# The inputs to this node will be stored as a list in the IN variables.
dataEnteringNode = IN

# Place your code below this line
def getTargetforWall(SettingsDS, WM, masonWall):
    targets = []
    
    if "Plaster" in WM:
        for i in SettingsDS["roomDS"]["roomsideface"]:
            tmp = []
            for j in masonWall:
                if i.DoesIntersect(j):
                #if i.DoesIntersect(j.Geometry()[0]):
                    tmp.append(True)
                else:
                    tmp.append(False)
            if any(tmp):
                targets.append(i)
            else:
                pass
    else:
        targets = SettingsDS["roomDS"]["roomsideface"]
#        for i in SettingsDS["roomDS"]["roomsideface"]:
#            tmp = []
#            for j in masonWall:
#                if i.DoesIntersect(j.Geometry()[0]):
#                    tmp.append(False)
#                else:
#                    tmp.append(True)
#            if all(tmp):
#                targets.append(i)
#            else:
#                pass
            
    return targets
# Assign your output to the OUT variable.
OUT = getTargetforWall
# ----------------------------------------
gettargetforfloor = Python()  # CPython3; unwired: IN[0]
# ---------- gettargetforfloor.python (21 lines) ----------
# Load the Python Standard and DesignScript Libraries
import sys
import clr
clr.AddReference('ProtoGeometry')
from Autodesk.DesignScript.Geometry import *

# The inputs to this node will be stored as a list in the IN variables.
dataEnteringNode = IN

# Place your code below this line
def getTargetforFloor(SettingsDS, WM):
    targets = []
    
    if "Something" in WM:
        pass
    else:
        targets = SettingsDS["roomDS"]["roombottomface"]

    return targets
# Assign your output to the OUT variable.
OUT = getTargetforFloor
# ----------------------------------------
gettargetforroof = Python()  # CPython3; unwired: IN[0]
# ---------- gettargetforroof.python (21 lines) ----------
# Load the Python Standard and DesignScript Libraries
import sys
import clr
clr.AddReference('ProtoGeometry')
from Autodesk.DesignScript.Geometry import *

# The inputs to this node will be stored as a list in the IN variables.
dataEnteringNode = IN

# Place your code below this line
def getTargetforRoof(SettingsDS, WM):
    targets = []
    
    if "Something" in WM:
        pass
    else:
        targets = SettingsDS["roomDS"]["roomupperface"]

    return targets
# Assign your output to the OUT variable.
OUT = getTargetforRoof
# ----------------------------------------
gettargetforextwall = Python()  # CPython3; unwired: IN[0], IN[1]
# ---------- gettargetforextwall.python (30 lines) ----------
# Load the Python Standard and DesignScript Libraries
import sys
import clr
clr.AddReference('ProtoGeometry')
from Autodesk.DesignScript.Geometry import *

# The inputs to this node will be stored as a list in the IN variables.
dataEnteringNode = IN
input = IN[0]
#extWall = IN[1]
#refs = IN[1]
#extWall = set(filter(lambda x: "Exterior" in x.Name, refs))
#masonWall = set(filter(lambda x: "Block" in x.Name or "Brick" in x.Name, refs))
#nonMasonWall = set(filter(lambda x: not "Block" in x.Name and not "Brick" in x.Name, refs))

# Place your code below this line
def getTargetforExtWall(SettingsDS, WM, extWall, extWallGeo):
    targets = []
    for i in range(len(extWall)):
        tmp1 = []
        for j in SettingsDS["roomDS"]["disc_line"]:
            if extWallGeo[i].DoesIntersect(j):
                tmp1.append(True)
        if any(tmp1):
            targets.append(extWall[i])
    #targets = [i for i in extWall if any([True for j in SettingsDS["roomDS"]["disc_line"] if i.DoesIntersect(j)])]
    #targets = [i for i in extWall if any([True for j in SettingsDS["roomDS"]["disc_line"] if i.Geometry()[0].DoesIntersect(j)])]
    return targets
# Assign your output to the OUT variable.
OUT = getTargetforExtWall
# ----------------------------------------
python_func_list_join = Python(IN[0]=gettargetforbase, IN[1]=gettargetforceil, IN[2]=gettargetforwall, IN[3]=gettargetforfloor, IN[4]=gettargetforroof, IN[5]=gettargetforextwall)  # CPython3
# ---------- python_func_list_join.python (13 lines) ----------
# Load the Python Standard and DesignScript Libraries
import sys
import clr
clr.AddReference('ProtoGeometry')
from Autodesk.DesignScript.Geometry import *

# The inputs to this node will be stored as a list in the IN variables.
dataEnteringNode = IN

# Place your code below this line

# Assign your output to the OUT variable.
OUT = IN
# ----------------------------------------
masonWall_Geometry = Python(IN[0]=all_elements_of_category_3)  # CPython3
# ---------- masonWall_Geometry.python (13 lines) ----------
# Load the Python Standard and DesignScript Libraries
import sys
import clr
clr.AddReference('ProtoGeometry')
from Autodesk.DesignScript.Geometry import *

# The inputs to this node will be stored as a list in the IN variables.
dataEnteringNode = IN
refs = IN[0]
# Place your code below this line
masonWall = set(map(lambda y: y.Geometry()[0],filter(lambda x: "Block" in x.Name or "Brick" in x.Name, refs)))
# Assign your output to the OUT variable.
OUT = masonWall
# ----------------------------------------
calculateValueForWM = Python(IN[0]=settingsDS, IN[1]=all_elements_of_category_3, IN[2]=python_func_list_join, IN[3]=masonWall_Geometry)  # CPython3
# ---------- calculateValueForWM.python (105 lines) ----------
# Load the Python Standard and DesignScript Libraries
import sys
import clr
clr.AddReference('ProtoGeometry')
from Autodesk.DesignScript.Geometry import *

clr.AddReference("RevitNodes")
import Revit

from Revit.Elements import *

clr.AddReference("DSCoreNodes")
from DSCore import *

from itertools import chain

# The inputs to this node will be stored as a list in the IN variables.
dataEnteringNode = IN
inputs = IN[0]
refs = IN[1]
funcs = IN[2]
#masonWall = IN[3]

getTargetforBase = funcs[0]
getTargetforCeil = funcs[1]
getTargetforWall = funcs[2] ##funtion instance
getTargetforFloor = funcs[3]
getTargetforRoof = funcs[4]
getTargetforExtWall = funcs[5] ##funtion instance


walltype = set(map(lambda x: x.Name, refs))
#intWall = set(filter(lambda x: "Interior" in x.Name, refs))
extWall = list(filter(lambda x: "Exterior" in x.Name, refs))
extWallGeo = list(map(lambda y: y.Geometry()[0], filter(lambda x: "Exterior" in x.Name, refs)))
masonWallGeo = list(map(lambda y: y.Geometry()[0], filter(lambda x: "Block" in x.Name or "Brick" in x.Name, refs)))
#nonMasonWall = set(filter(lambda x: not "Block" in x.Name and not "Brick" in x.Name, refs))

def checkValid(value):
    try:
        return value
    except:
        pass

def CalcualteValueForWM(SettingsDS, funcs):

    name = SettingsDS["roomDS"]["name"]
    roomDS = SettingsDS["roomDS"]
    baseWM = SettingsDS["baseWM"]
    ceilWM = SettingsDS["ceilWM"]
    wallWM = SettingsDS["wallWM"]
    floorWM = SettingsDS["floorWM"]
    roofWM = SettingsDS["roofWM"]
    extwallWM = SettingsDS["extwallWM"]
    
    def unitcalc(SettingsDS, WM, finishtype):
        if finishtype == "base": #roomperimeter
            target = getTargetforBase(SettingsDS, WM)
            calcvalue = round(sum(list(map(lambda x: x.Length, target)))/1000,2)
            unit = "M"
        elif finishtype == "ceil":
            target = getTargetforCeil(SettingsDS, WM)
            calcvalue = round(sum(list(map(lambda x: x.Area, target)))/1000000,2)
            unit = "M2"
        elif finishtype == "wall":
            target = getTargetforWall(SettingsDS, WM, masonWallGeo)
            calcvalue = round(sum(list(map(lambda x: x.Area, target)))/1000000,2)
            unit = "M2"
        elif finishtype == "floor":
            target = getTargetforCeil(SettingsDS, WM)
            calcvalue = round(sum(list(map(lambda x: x.Area, target)))/1000000,2)
            unit = "M2"
        elif finishtype == "roof":
            target = getTargetforCeil(SettingsDS, WM)
            calcvalue = round(sum(list(map(lambda x: x.Area, target)))/1000000,2)
            unit = "M2"
        elif finishtype == "extwall":
            target = getTargetforExtWall(SettingsDS, WM, extWall, extWallGeo)
            calcvalue = sum(list(map(lambda x: x.GetParameterValueByName("Area"), target)))
            unit = "M2"
            
        result = []
        result.append(SettingsDS["name"])
        result.append(SettingsDS["roomDS"]["roomelem"].GetParameterValueByName("Department"))
#        result.append(WM)
        result.append(WM.split(': ')[0]) ##WM code
        result.append(WM.split(': ')[1]) ##WM description
        result.append(calcvalue)
        result.append(unit)
        return result
    value_base = checkValid(list(map(lambda x: checkValid(unitcalc(SettingsDS, x, "base")), baseWM)))
    value_ceil = checkValid(list(map(lambda x: checkValid(unitcalc(SettingsDS, x, "ceil")), ceilWM)))
    value_wall = checkValid(list(map(lambda x: checkValid(unitcalc(SettingsDS, x, "wall")), wallWM)))
    value_floor = checkValid(list(map(lambda x: checkValid(unitcalc(SettingsDS, x, "floor")), floorWM)))
    value_roof = checkValid(list(map(lambda x: checkValid(unitcalc(SettingsDS, x, "roof")), roofWM)))
    value_extwall = checkValid(list(map(lambda x: checkValid(unitcalc(SettingsDS, x, "extwall")), extwallWM)))
    
    
    return value_base + value_ceil + value_wall + value_floor + value_roof + value_extwall
result = [CalcualteValueForWM(x, funcs) for x in inputs]



# Assign your output to the OUT variable.
OUT = result
# ----------------------------------------
flatten_14 = List.Flatten(list=calculateValueForWM@L2)

# group: Export Excel(By OpenpyXl)
python_script_export_excel_by = Python(IN[0]=flatten_14)  # "Python Script@Export Excel(By OpenpyXl)"; CPython3
# ---------- python_script_export_excel_by.python (139 lines) ----------
# Load the Python Standard and DesignScript Libraries
import sys
import os
#sys.path.append(r'C:\Users\HEC\AppData\Local\Programs\Python\Python39\Lib\site-packages')
#sys.path.append(r'C:\Users\pjmk0\AppData\Local\Programs\Python\Python39\Lib\site-packages')
sys.path.append(os.getenv('LOCALAPPDATA').replace('\\','\\\\') + r'\Programs\Python\Python39\Lib\site-packages')
import clr
clr.AddReference('ProtoGeometry')
from Autodesk.DesignScript.Geometry import *
from collections import Iterable

def iterable(obj):
    return isinstance(obj, Iterable)


# The inputs to this node will be stored as a list in the IN variables.
dataEnteringNode = IN
ListIn = IN[0]

# Place your code below this line
import datetime
from datetime import date, timedelta
Today = date.today()
import openpyxl
from openpyxl.styles import Border, Side, PatternFill, Font, GradientFill, Alignment, Color, numbers

sample_items = ListIn


def write_to_file(filepath):
    wb = openpyxl.Workbook()
    for sheet in wb.sheetnames:
        wb.remove(wb[sheet])

    thin = Side(border_style="thin", color="000000")
    double = Side(border_style="double", color="000000")

    ws = wb.create_sheet(title='Wall_Calc_instance', index=0)

    ws.merge_cells('A1:L1')
    ws['A1'] = 'HEC Bidding Calculation Sheet'
    cell = ws['A1']
    cell.font = openpyxl.styles.Font(color='000000', size=20)
    cell.fill = openpyxl.styles.fills.PatternFill(patternType='solid', fgColor=openpyxl.styles.colors.Color(rgb='fff3b0'))

    ws['A2'] = 'Item Number'
    ws['A2'].font = openpyxl.styles.Font(b=True, color='000000', size=12)
    ws['B2'] = 'Room Name'
    ws['B2'].font = openpyxl.styles.Font(b=True, color='000000', size=12)
    ws['C2'] = 'Department'
    ws['C2'].font = openpyxl.styles.Font(b=True, color='000000', size=12)
#    ws['D2'] = 'Interior Finish Type'
#    ws['D2'].font = openpyxl.styles.Font(b=True, color='000000', size=12)
    ws['D2'] = 'WorkMaster Code'
    ws['D2'].font = openpyxl.styles.Font(b=True, color='000000', size=12)
    ws['E2'] = 'Description'
    ws['E2'].font = openpyxl.styles.Font(b=True, color='000000', size=12)
#    ws['G2'] = '계수'
#    ws['G2'].font = openpyxl.styles.Font(b=True, color='000000', size=12)
#    ws['H2'] = '계산 참조값'
#    ws['H2'].font = openpyxl.styles.Font(b=True, color='000000', size=12)
    ws['F2'] = 'Quantities'
    ws['F2'].font = openpyxl.styles.Font(b=True, color='000000', size=12)
    ws['G2'] = 'Unit'
    ws['G2'].font = openpyxl.styles.Font(b=True, color='000000', size=12)
    ws['H2'] = 'Unit Price'
    ws['H2'].font = openpyxl.styles.Font(b=True, color='000000', size=12)
    ws['I2'] = 'Total Price'
    ws['I2'].font = openpyxl.styles.Font(b=True, color='000000', size=12)


## 칼럼별 너비 조정 구간
#    for col in range(ws.max_column):
#        ws.column_dimensions[chr(ord('A') + col)].width = 15
    ws.column_dimensions['A'].width = 15 ##Item Number
    ws.column_dimensions['B'].width = 25 ##Room
    ws.column_dimensions['C'].width = 12 ##Department
    ws.column_dimensions['D'].width = 20 ##WorkMaster Code
    ws.column_dimensions['E'].width = 52 ##Description
    ws.column_dimensions['F'].width = 9 ##Quantities
    ws.column_dimensions['G'].width = 9 ##Unit
    ws.column_dimensions['H'].width = 12 ##Unit Price
    ws.column_dimensions['I'].width = 12 ##Total Price
#    ws.column_dimensions['G'].hidden = True

###
    start_row = 3
    for (row, item) in enumerate(sample_items, start_row):
        cell = ws.cell(row=row, column=1, value=row - 2)
        cell.alignment = openpyxl.styles.Alignment(horizontal='center', vertical='center')

#        cell = ws.cell(row=row, column=2, value=item[0])
#        cell.number_format = openpyxl.styles.numbers.FORMAT_DATE_YYYYMMDD2  # 'yyyy-mm-dd'
        ws.cell(row=row, column=2, value=item[0]) ## Room Name 칼럼

        ws.cell(row=row, column=3, value=item[1]) ## Department 칼럼
        
        ws.cell(row=row, column=4, value=item[2]) ## WorkMaster Code 칼럼
        
        ws.cell(row=row, column=5, value=item[3]) ## WorkMaster Description 칼럼
        
        cell = ws.cell(row=row, column=6, value=item[4]) ## Quantities 칼럼
        cell.number_format = '#.##'
#        cell.number_format = openpyxl.styles.numbers.builtin_format_code(3)  # '#,##0'
        cell.font = openpyxl.styles.Font(b=True, color='000000', size=11)
        
        ws.cell(row=row, column=7, value=item[5]) ## Unit 칼럼

        cell = ws.cell(row=row, column=9, value='= F{current_row}*H{current_row}'.format(current_row=cell.row))
        cell.number_format = '#.##'

#        cell = ws.cell(row=row, column=6, value='= D{current_row} * E{current_row}'.format(current_row=cell.row))
#        cell.number_format = openpyxl.styles.numbers.builtin_format_code(3)

    total_row = ws.max_row + 1
    if total_row > start_row:
        cell1 = ws.cell(row=total_row, column=8, value='Total')
        cell1.font = openpyxl.styles.Font(b=True, color='000000', size=15)
        
        cell2 = ws.cell(row=total_row, column=9, value='= SUM(I{}:I{})'.format(start_row, total_row - 1))
        cell2.number_format = '#.##'#openpyxl.styles.numbers.builtin_format_code(3)
        cell2.border = Border(top=double, left=double, right=double, bottom=double)
        cell2.font = openpyxl.styles.Font(b=True, color='ff03ce', size=15)
    

    wb.save(filepath)
    wb.close()


##if __name__ == '__main__':
#write_to_file('C:\\Users\\pjmk0\\AppData\\Roaming\\test.xlsx')
save_name = "HecBiddingCalcSheet_" + Today.strftime("%Y-%m-%d")+".xlsx"
path = os.getenv('APPDATA').replace('\\','\\\\')
filePath = path + '\\' + save_name

write_to_file(filePath)

# Assign your output to the OUT variable.
OUT = os.getenv('APPDATA')
# ----------------------------------------

calculateBaseValueForWM = Python(IN[0]=settingsDS, IN[1]=all_elements_of_category_3, IN[2]=python_func_list_join)  # CPython3; frozen
# ---------- calculateBaseValueForWM.python (66 lines) ----------
# Load the Python Standard and DesignScript Libraries
import sys
import clr
clr.AddReference('ProtoGeometry')
from Autodesk.DesignScript.Geometry import *

clr.AddReference("RevitNodes")
import Revit

from Revit.Elements import *

clr.AddReference("DSCoreNodes")
from DSCore import *

from itertools import chain

# The inputs to this node will be stored as a list in the IN variables.
dataEnteringNode = IN
inputs = IN[0]
refs = IN[1]
funcs = IN[2]
getTargetforBase = funcs[0]


walltype = set(map(lambda x: x.Name, refs))
intWall = set(filter(lambda x: "Interior" in x.Name, refs))
extWall = set(filter(lambda x: "Exterior" in x.Name, refs))
masonWall = set(filter(lambda x: "Block" in x.Name or "Brick" in x.Name, refs))
#nonMasonWall = set(filter(lambda x: not "Block" in x.Name and not "Brick" in x.Name, refs))

def checkValid(value):
    try:
        return value
    except:
        pass

def CalcualteValueForWM(SettingsDS, funcs):

    name = SettingsDS["roomDS"]["name"]
    roomDS = SettingsDS["roomDS"]
    baseWM = SettingsDS["baseWM"]
    
    def unitcalc(SettingsDS, WM):
        #elif finishtype == "base":
        target = getTargetforBase(SettingsDS, WM)
        calcvalue = round(sum(list(map(lambda x: x.Length, target)))/1000,2)
        unit = "M"
            
        result = []
        result.append(SettingsDS["name"])
        result.append(SettingsDS["roomDS"]["roomelem"].GetParameterValueByName("Department"))
        result.append(WM.split(': ')[0]) ##WM code
        result.append(WM.split(': ')[1]) ##WM description
        result.append(calcvalue)
        result.append(unit)
        return result
    value_base = checkValid(list(map(lambda x: checkValid(unitcalc(SettingsDS, x)), baseWM)))
    
    
    return value_base
result = [CalcualteValueForWM(x, funcs) for x in inputs]



# Assign your output to the OUT variable.
OUT = result
# ----------------------------------------
calculateCeilValueForWM = Python(IN[0]=settingsDS, IN[1]=all_elements_of_category_3, IN[2]=python_func_list_join)  # CPython3; frozen
# ---------- calculateCeilValueForWM.python (67 lines) ----------
# Load the Python Standard and DesignScript Libraries
import sys
import clr
clr.AddReference('ProtoGeometry')
from Autodesk.DesignScript.Geometry import *

clr.AddReference("RevitNodes")
import Revit

from Revit.Elements import *

clr.AddReference("DSCoreNodes")
from DSCore import *

from itertools import chain

# The inputs to this node will be stored as a list in the IN variables.
dataEnteringNode = IN
inputs = IN[0]
refs = IN[1]
funcs = IN[2]

getTargetforCeil = funcs[1]

walltype = set(map(lambda x: x.Name, refs))
intWall = set(filter(lambda x: "Interior" in x.Name, refs))
extWall = set(filter(lambda x: "Exterior" in x.Name, refs))
masonWall = set(filter(lambda x: "Block" in x.Name or "Brick" in x.Name, refs))
#nonMasonWall = set(filter(lambda x: not "Block" in x.Name and not "Brick" in x.Name, refs))

def checkValid(value):
    try:
        return value
    except:
        pass

def CalcualteValueForWM(SettingsDS, funcs):

    name = SettingsDS["roomDS"]["name"]
    roomDS = SettingsDS["roomDS"]
    ceilWM = SettingsDS["ceilWM"]
    
    def unitcalc(SettingsDS, WM):
        #elif finishtype == "ceil":
        target = getTargetforCeil(SettingsDS, WM)
        calcvalue = round(sum(list(map(lambda x: x.Area, target)))/1000000,2)
        unit = "M2"
            
        result = []
        result.append(SettingsDS["name"])
        result.append(SettingsDS["roomDS"]["roomelem"].GetParameterValueByName("Department"))
        result.append(WM.split(': ')[0]) ##WM code
        result.append(WM.split(': ')[1]) ##WM description
        result.append(calcvalue)
        result.append(unit)
        return result

    value_ceil = checkValid(list(map(lambda x: checkValid(unitcalc(SettingsDS, x)), ceilWM)))
    
    
    return value_ceil
result = [CalcualteValueForWM(x, funcs) for x in inputs]



# Assign your output to the OUT variable.
OUT = result
# ----------------------------------------
calculateWallValueForWM = Python(IN[0]=settingsDS, IN[1]=masonWall_Geometry, IN[2]=python_func_list_join)  # CPython3; frozen
# ---------- calculateWallValueForWM.python (88 lines) ----------
# Load the Python Standard and DesignScript Libraries
import sys
import clr
clr.AddReference('ProtoGeometry')
from Autodesk.DesignScript.Geometry import *

clr.AddReference("RevitNodes")
import Revit

from Revit.Elements import *

clr.AddReference("DSCoreNodes")
from DSCore import *

from itertools import chain

# The inputs to this node will be stored as a list in the IN variables.
dataEnteringNode = IN
inputs = IN[0]
masonWall = IN[1]
#funcs = IN[2]

#getTargetforWall = funcs[2] ##funtion instance
def getTargetforWall(SettingsDS, WM, masonWall):
    targets = []
    
    if "Plaster" in WM:
        for i in SettingsDS["roomDS"]["roomsideface"]:
            tmp = []
            for j in masonWall:
                if i.DoesIntersect(j):
                    tmp.append(True)
                else:
                    tmp.append(False)
            if any(tmp):
                targets.append(i)
            else:
                pass
    else:
        targets = SettingsDS["roomDS"]["roomsideface"]
    return targets


#walltype = set(map(lambda x: x.Name, refs))
#intWall = set(filter(lambda x: "Interior" in x.Name, refs))
#extWall = set(filter(lambda x: "Exterior" in x.Name, refs))
#masonWall = set(filter(lambda x: "Block" in x.Name or "Brick" in x.Name, refs))
#nonMasonWall = set(filter(lambda x: not "Block" in x.Name and not "Brick" in x.Name, refs))

def checkValid(value):
    try:
        return value
    except:
        pass

def CalcualteValueForWM(SettingsDS, funcs):

    name = SettingsDS["roomDS"]["name"]
    roomDS = SettingsDS["roomDS"]
    wallWM = SettingsDS["wallWM"]

    
    def unitcalc(SettingsDS, WM):
        #elif finishtype == "wall":
        target = getTargetforWall(SettingsDS, WM, masonWall)
        calcvalue = round(sum(list(map(lambda x: x.Area, target)))/1000000,2)
        unit = "M2"
            
        result = []
        result.append(SettingsDS["name"])
        result.append(SettingsDS["roomDS"]["roomelem"].GetParameterValueByName("Department"))
        result.append(WM.split(': ')[0]) ##WM code
        result.append(WM.split(': ')[1]) ##WM description
        result.append(calcvalue)
        result.append(unit)
        return result

    value_wall = checkValid(list(map(lambda x: checkValid(unitcalc(SettingsDS, x)), wallWM)))
    
    
    return value_wall

result = [CalcualteValueForWM(x, getTargetforWall) for x in inputs]
#result =  [CalcualteValueForWM(inputs[0], getTargetforWall) + CalcualteValueForWM(inputs[1], getTargetforWall) + CalcualteValueForWM(inputs[3], getTargetforWall)]


# Assign your output to the OUT variable.
OUT = result
# ----------------------------------------
calculateBaseValueForWM_2 = Python(IN[0]=settingsDS, IN[1]=all_elements_of_category_3, IN[2]=python_func_list_join)  # CPython3; frozen
# ---------- calculateBaseValueForWM_2.python (98 lines) ----------
# Load the Python Standard and DesignScript Libraries
import sys
import clr
clr.AddReference('ProtoGeometry')
from Autodesk.DesignScript.Geometry import *

clr.AddReference("RevitNodes")
import Revit

from Revit.Elements import *

clr.AddReference("DSCoreNodes")
from DSCore import *

from itertools import chain

# The inputs to this node will be stored as a list in the IN variables.
dataEnteringNode = IN
inputs = IN[0]
refs = IN[1]
funcs = IN[2]
getTargetforBase = funcs[0]



walltype = set(map(lambda x: x.Name, refs))
intWall = set(filter(lambda x: "Interior" in x.Name, refs))
extWall = set(filter(lambda x: "Exterior" in x.Name, refs))
masonWall = set(filter(lambda x: "Block" in x.Name or "Brick" in x.Name, refs))
#nonMasonWall = set(filter(lambda x: not "Block" in x.Name and not "Brick" in x.Name, refs))

def checkValid(value):
    try:
        return value
    except:
        pass

def CalcualteValueForWM(SettingsDS, funcs):

    name = SettingsDS["roomDS"]["name"]
    roomDS = SettingsDS["roomDS"]
    baseWM = SettingsDS["baseWM"]
    ceilWM = SettingsDS["ceilWM"]
    wallWM = SettingsDS["wallWM"]
    floorWM = SettingsDS["floorWM"]
    roofWM = SettingsDS["roofWM"]
    extwallWM = SettingsDS["extwallWM"]
    
    def unitcalc(SettingsDS, WM, finishtype):
        if finishtype == "base": #roomperimeter
            target = getTargetforBase(SettingsDS, WM)
            calcvalue = round(sum(list(map(lambda x: x.Length, target)))/1000,2)
            unit = "M"
        elif finishtype == "ceil":
            target = getTargetforCeil(SettingsDS, WM)
            calcvalue = round(sum(list(map(lambda x: x.Area, target)))/1000000,2)
            unit = "M2"
        elif finishtype == "wall":
            target = getTargetforWall(SettingsDS, WM, masonWall)
            calcvalue = round(sum(list(map(lambda x: x.Area, target)))/1000000,2)
            unit = "M2"
        elif finishtype == "floor":
            target = getTargetforCeil(SettingsDS, WM)
            calcvalue = round(sum(list(map(lambda x: x.Area, target)))/1000000,2)
            unit = "M2"
        elif finishtype == "roof":
            target = getTargetforCeil(SettingsDS, WM)
            calcvalue = round(sum(list(map(lambda x: x.Area, target)))/1000000,2)
            unit = "M2"
        elif finishtype == "extwall":
            target = getTargetforExtWall(SettingsDS, WM, extWall)
            calcvalue = sum(list(map(lambda x: x.GetParameterValueByName("Area"), target)))
            unit = "M2"
            
        result = []
        result.append(SettingsDS["name"])
        result.append(SettingsDS["roomDS"]["roomelem"].GetParameterValueByName("Department"))
#        result.append(WM)
        result.append(WM.split(': ')[0]) ##WM code
        result.append(WM.split(': ')[1]) ##WM description
        result.append(calcvalue)
        result.append(unit)
        return result
    value_base = checkValid(list(map(lambda x: checkValid(unitcalc(SettingsDS, x, "base")), baseWM)))
    value_ceil = checkValid(list(map(lambda x: checkValid(unitcalc(SettingsDS, x, "ceil")), ceilWM)))
    value_wall = checkValid(list(map(lambda x: checkValid(unitcalc(SettingsDS, x, "wall")), wallWM)))
    value_floor = checkValid(list(map(lambda x: checkValid(unitcalc(SettingsDS, x, "floor")), floorWM)))
    value_roof = checkValid(list(map(lambda x: checkValid(unitcalc(SettingsDS, x, "roof")), roofWM)))
    value_extwall = checkValid(list(map(lambda x: checkValid(unitcalc(SettingsDS, x, "extwall")), extwallWM)))
    
    
    return value_base + value_ceil + value_wall + value_floor + value_roof + value_extwall
result = [CalcualteValueForWM(x, funcs) for x in inputs]



# Assign your output to the OUT variable.
OUT = result
# ----------------------------------------
calculateBaseValueForWM_3 = Python(IN[0]=settingsDS, IN[1]=all_elements_of_category_3, IN[2]=python_func_list_join)  # CPython3; frozen
# ---------- calculateBaseValueForWM_3.python (102 lines) ----------
# Load the Python Standard and DesignScript Libraries
import sys
import clr
clr.AddReference('ProtoGeometry')
from Autodesk.DesignScript.Geometry import *

clr.AddReference("RevitNodes")
import Revit

from Revit.Elements import *

clr.AddReference("DSCoreNodes")
from DSCore import *

from itertools import chain

# The inputs to this node will be stored as a list in the IN variables.
dataEnteringNode = IN
inputs = IN[0]
refs = IN[1]
funcs = IN[2]
getTargetforBase = funcs[0]
getTargetforCeil = funcs[1]
getTargetforWall = funcs[2] ##funtion instance
getTargetforFloor = funcs[3]
getTargetforRoof = funcs[4]
getTargetforExtWall = funcs[5] ##funtion instance


walltype = set(map(lambda x: x.Name, refs))
intWall = set(filter(lambda x: "Interior" in x.Name, refs))
extWall = set(filter(lambda x: "Exterior" in x.Name, refs))
masonWall = set(filter(lambda x: "Block" in x.Name or "Brick" in x.Name, refs))
nonMasonWall = set(filter(lambda x: not "Block" in x.Name and not "Brick" in x.Name, refs))

def checkValid(value):
    try:
        return value
    except:
        pass

def CalcualteValueForWM(SettingsDS, funcs):

    name = SettingsDS["roomDS"]["name"]
    roomDS = SettingsDS["roomDS"]
    baseWM = SettingsDS["baseWM"]
    ceilWM = SettingsDS["ceilWM"]
    wallWM = SettingsDS["wallWM"]
    floorWM = SettingsDS["floorWM"]
    roofWM = SettingsDS["roofWM"]
    extwallWM = SettingsDS["extwallWM"]
    
    def unitcalc(SettingsDS, WM, finishtype):
        if finishtype == "base": #roomperimeter
            target = getTargetforBase(SettingsDS, WM)
            calcvalue = round(sum(list(map(lambda x: x.Length, target)))/1000,2)
            unit = "M"
        elif finishtype == "ceil":
            target = getTargetforCeil(SettingsDS, WM)
            calcvalue = round(sum(list(map(lambda x: x.Area, target)))/1000000,2)
            unit = "M2"
        elif finishtype == "wall":
            target = getTargetforWall(SettingsDS, WM, masonWall)
            calcvalue = round(sum(list(map(lambda x: x.Area, target)))/1000000,2)
            unit = "M2"
        elif finishtype == "floor":
            target = getTargetforCeil(SettingsDS, WM)
            calcvalue = round(sum(list(map(lambda x: x.Area, target)))/1000000,2)
            unit = "M2"
        elif finishtype == "roof":
            target = getTargetforCeil(SettingsDS, WM)
            calcvalue = round(sum(list(map(lambda x: x.Area, target)))/1000000,2)
            unit = "M2"
        elif finishtype == "extwall":
            target = getTargetforExtWall(SettingsDS, WM, extWall)
            calcvalue = sum(list(map(lambda x: x.GetParameterValueByName("Area"), target)))
            unit = "M2"
            
        result = []
        result.append(SettingsDS["name"])
        result.append(SettingsDS["roomDS"]["roomelem"].GetParameterValueByName("Department"))
#        result.append(WM)
        result.append(WM.split(': ')[0]) ##WM code
        result.append(WM.split(': ')[1]) ##WM description
        result.append(calcvalue)
        result.append(unit)
        return result
    value_base = checkValid(list(map(lambda x: checkValid(unitcalc(SettingsDS, x, "base")), baseWM)))
    value_ceil = checkValid(list(map(lambda x: checkValid(unitcalc(SettingsDS, x, "ceil")), ceilWM)))
    value_wall = checkValid(list(map(lambda x: checkValid(unitcalc(SettingsDS, x, "wall")), wallWM)))
    value_floor = checkValid(list(map(lambda x: checkValid(unitcalc(SettingsDS, x, "floor")), floorWM)))
    value_roof = checkValid(list(map(lambda x: checkValid(unitcalc(SettingsDS, x, "roof")), roofWM)))
    value_extwall = checkValid(list(map(lambda x: checkValid(unitcalc(SettingsDS, x, "extwall")), extwallWM)))
    
    
    return value_base + value_ceil + value_wall + value_floor + value_roof + value_extwall
result = [CalcualteValueForWM(x, funcs) for x in inputs]



# Assign your output to the OUT variable.
OUT = result
# ----------------------------------------
calculateBaseValueForWM_4 = Python(IN[0]=settingsDS, IN[1]=all_elements_of_category_3, IN[2]=python_func_list_join)  # CPython3; frozen; same code as calculateBaseValueForWM_3
gettargetforwall_2 = Python(IN[0]=settingsDS, IN[1]=all_elements_of_category_3)  # CPython3; frozen
# ---------- gettargetforwall_2.python (47 lines) ----------
# Load the Python Standard and DesignScript Libraries
import sys
import clr
clr.AddReference('ProtoGeometry')
from Autodesk.DesignScript.Geometry import *

# The inputs to this node will be stored as a list in the IN variables.
dataEnteringNode = IN
SettingsDS =IN[0]
refs = IN[1]
WM = SettingsDS["wallWM"]
masonWall = set(filter(lambda x: "Block" in x.Name or "Brick" in x.Name, refs))

# Place your code below this line
def getTargetforWall(SettingsDS, masonWall):
    #WM = SettingsDS["wallWM"][0]
    targets = []
    
    if "Plaster" in WM:
        for i in SettingsDS["roomDS"]["roomsideface"]:
            tmp = []
            for j in masonWall:
                if i.DoesIntersect(j.Geometry()[0]):
                    tmp.append(True)
                else:
                    tmp.append(False)
            if any(tmp):
                targets.append(i)
            else:
                pass
    else:
        targets = SettingsDS["roomDS"]["roomsideface"]
#        for i in SettingsDS["roomDS"]["roomsideface"]:
#            tmp = []
#            for j in masonWall:
#                if i.DoesIntersect(j.Geometry()[0]):
#                    tmp.append(False)
#                else:
#                    tmp.append(True)
#            if all(tmp):
#                targets.append(i)
#            else:
#                pass
            
    return targets
# Assign your output to the OUT variable.
OUT = list(map(lambda i: getTargetforWall(i, masonWall), SettingsDS))
# ----------------------------------------
