# Dynamo graph 4_Bidding Quantity Calculation(1209).dyn (Dynamo 2.10.1.3976)

# group: WM data 부여 구간

# group: Discipline data 부여 구간

# group: Room Name data 부여 구간

# group: Quantities data 전처리 구간

# group: Quantities data 최종계산 및 부여 구간

# group: All Room Elements
categories = Categories("OST_Rooms")
all_elements_of_category = ElementsOfCategory(Category=categories)  # frozen
parameters = Element.Parameters(element=all_elements_of_category)

# group: Room Elements 들의 속성값 추출
code_block = CodeBlock { "Exterior Finish"; }
getParameterValueByName = Element.GetParameterValueByName(element=all_elements_of_category, parameterName=code_block)
code_block_2 = CodeBlock { "Interior Finish"; }
getParameterValueByName_2 = Element.GetParameterValueByName(element=all_elements_of_category, parameterName=code_block_2)
name = Element.Name(element=all_elements_of_category)
code_block_3 = CodeBlock { "Department"; }
getParameterValueByName_3 = Element.GetParameterValueByName(element=all_elements_of_category, parameterName=code_block_3)
code_block_4 = CodeBlock { "Area"; }
getParameterValueByName_4 = Element.GetParameterValueByName(element=all_elements_of_category, parameterName=code_block_4)
code_block_5 = CodeBlock(t1=getParameterValueByName_4) { num2 = (Math.Round(t1, 2)/1); }
code_block_6 = CodeBlock { "Perimeter"; }
getParameterValueByName_5 = Element.GetParameterValueByName(element=all_elements_of_category, parameterName=code_block_6)
code_block_7 = CodeBlock(t1=getParameterValueByName_5) { num2 = (Math.Round(t1, 2)/1000); }

code_block_8 = CodeBlock { "Unbounded Height"; }
getParameterValueByName_6 = Element.GetParameterValueByName(element=all_elements_of_category, parameterName=code_block_8)
uniqueItems = List.UniqueItems(list=getParameterValueByName_6)
firstItem = List.FirstItem(list=uniqueItems)
watch = Watch(getParameterValueByName_2)

# group: Interior Finish Type 별 WM define
interior_finish_type = CodeBlock()
# ---------- interior_finish_type.designscript (9 lines) ----------
[
"NA",
"IF1",
"IF2",
"IF2-1",
"IF3",
"IF4",
"IF5"
];
# ----------------------------------------
interior_finish_floor = CodeBlock()
# ---------- interior_finish_floor.designscript (9 lines) ----------
[
["na...na...na"],
["A04AL080-00006...Epoxy paint(Floor)...M2"],
["A04AM083-00004...Vinyl Tile(Floor)...M2"],
["A04AM083-00004...Vinyl Tile(Floor)...M2"],
["A04AM083-00005...Anti-Static Vinyl Tile(Floor)...M2"],
["A04AL080-00003...Acid/Alkaline Resistant Paint(Floor)...M2"],
["A04AM083-00001...Ceramic Tile(Floor)...M2", "A04AN000-00001...Waterproofing Membrane(Floor)...M2"]
];
# ----------------------------------------
interior_finish_wall = CodeBlock()
# ---------- interior_finish_wall.designscript (12 lines) ----------
[
["na...na...na"],
["A04AL078-00003...Latex Paint(Wall)...M2"],
["A04AL078-00003...Latex Paint(Wall)...M2"],
["A04AL078-00003...Latex Paint(Wall)...M2"],
["A04AL078-00003...Latex Paint(Wall)...M2"],
["A04AL078-00004...Acid/Alkaline Resistant Paint, H=1.5(Wall)...M2",
"A04AL078-00003...Latex Paint(Wall)...M2"],
["A04AM082-00002...Glazed Ceramic Tile, H=1.8(Wall)...M2",
"A04AN000-00001...Waterproofing Membrane, H=1.8m(Wall)...M2",
"A04AL078-00003...Latex Paint(Wall)...M2"]
];
# ----------------------------------------
interior_finish_skirt = CodeBlock()
# ---------- interior_finish_skirt.designscript (9 lines) ----------
[
["na...na...na"],
["A04AL081-00007...Epoxy paint H=100(Skirt)...M"],
["A04AR151-00001...Coved Rubber Skirting, H=100(Skirt)...M"],
["A04AR151-00001...Coved Rubber Skirting, H=100(Skirt)...M"],
["A04AR151-00001...Coved Rubber Skirting, H=100(Skirt)...M"],
["A04AL081-00004...Acid/Alkaline Resistant Paint H=100(Skirt)...M"],
["A04AM084-00004...Glazed Ceramic Tile, H=100(Skirt)...M"]
];
# ----------------------------------------
interior_finish_ceiling = CodeBlock()
# ---------- interior_finish_ceiling.designscript (9 lines) ----------
[
["na...na...na"],
["A04AL079-00003...Latex Paint(Ceiling)...M2"],
["A04AL079-00003...Latex Paint(Ceiling)...M2"],
["A04AR156-00002...Acoustic Tiled Ceiling System, T-Bar(Ceiling)...M2"],
["A04AR156-00002...Acoustic Tiled Ceiling System, T-Bar(Ceiling)...M2"],
["A04AL079-00003...Latex Paint(Ceiling)...M2"],
["A04AR157-00002...Moisture Resistant Tiled Ceiling System, T-bar(Ceiling)...M2"]
];
# ----------------------------------------

allIndicesOf = List.AllIndicesOf(list=watch, item=interior_finish_type)
file_path = Filename(".\test1.xslx")
code_block_9 = CodeBlock { "Sheet1"; }
code_block_10 = CodeBlock { 0; }
watch_room_name = Watch(name)
watch_department = Watch(getParameterValueByName_3)

# group: WM 별 계산 수식 매칭 구간
interior_finish_floor_calc = CodeBlock()
# ---------- interior_finish_floor_calc.designscript (9 lines) ----------
[
[0],//NA
[1],
[1],
[1],
[1],
[1],
[1]
];
# ----------------------------------------
code_block_11 = CodeBlock(i=interior_finish_floor, j=interior_finish_floor_calc) { i + "..." + j; }
watch_2 = Watch(code_block_11)
code_block_12 = CodeBlock { 4; }
interior_finish_wall_calc = CodeBlock(h=code_block_12)
# ---------- interior_finish_wall_calc.designscript (12 lines) ----------
[
[0],
[h],
[h],
[h],
[h],
[1.5,
(h-1.5)],
[1.8,
1.8,
(h-1.8)]
];
# ----------------------------------------
code_block_13 = CodeBlock(i=interior_finish_wall, j=interior_finish_wall_calc) { i + "..." + j; }
watch_3 = Watch(code_block_13)
interior_finish_skirt_calc = CodeBlock()
# ---------- interior_finish_skirt_calc.designscript (9 lines) ----------
[
[0],
[1],
[1],
[1],
[1],
[1],
[1]
];
# ----------------------------------------
code_block_14 = CodeBlock(i=interior_finish_skirt, j=interior_finish_skirt_calc) { i + "..." + j; }
watch_4 = Watch(code_block_14)
interior_finish_ceiling_calc = CodeBlock()  # same code as interior_finish_skirt_calc
code_block_15 = CodeBlock(i=interior_finish_ceiling, j=interior_finish_ceiling_calc) { i + "..." + j; }
watch_5 = Watch(code_block_15)

# group (continued): Interior Finish Type 별 WM define
dictionary_bykeysvalues_floor = DesignScript.Builtin.Dictionary.ByKeysValues(keys=interior_finish_type, values=watch_2)
dictionary_bykeysvalues_wall = DesignScript.Builtin.Dictionary.ByKeysValues(keys=interior_finish_type, values=watch_3)
dictionary_bykeysvalues_skirt = DesignScript.Builtin.Dictionary.ByKeysValues(keys=interior_finish_type, values=watch_4)
dictionary_bykeysvalues_ceiling = DesignScript.Builtin.Dictionary.ByKeysValues(keys=interior_finish_type, values=watch_5)

# group: 개체별 해당 WM 부여
watch_6 = Watch(getParameterValueByName_2)
valueAtKey = DesignScript.Builtin.Dictionary.ValueAtKey(dictionary=dictionary_bykeysvalues_floor, key=watch_6)
watch_wm_floor = Watch(valueAtKey)
valueAtKey_2 = DesignScript.Builtin.Dictionary.ValueAtKey(dictionary=dictionary_bykeysvalues_wall, key=watch_6)
watch_wm_wall = Watch(valueAtKey_2)
valueAtKey_3 = DesignScript.Builtin.Dictionary.ValueAtKey(dictionary=dictionary_bykeysvalues_skirt, key=watch_6)
watch_wm_skirt = Watch(valueAtKey_3)
valueAtKey_4 = DesignScript.Builtin.Dictionary.ValueAtKey(dictionary=dictionary_bykeysvalues_ceiling, key=watch_6)
watch_wm_ceiling = Watch(valueAtKey_4)

# group: WM 개수당 개체 복제 후 매칭<Floor>
count = List.Count(list=watch_wm_floor@L2)
ofRepeatedItem = List.OfRepeatedItem(item=watch_6@L1, amount=count@L1)
code_block_16 = CodeBlock(a=ofRepeatedItem, b=watch_wm_floor) { a + "..." + b; }

# group: WM 개수당 개체 복제 후 매칭<Floor>
count_2 = List.Count(list=code_block_16@L2)
ofRepeatedItem_2 = List.OfRepeatedItem(item=watch_department@L1, amount=count_2@L1)
code_block_17 = CodeBlock(a=ofRepeatedItem_2, b=code_block_16) { a + "..." + b; }

# group: WM 개수당 개체 복제 후 매칭<Floor>
count_3 = List.Count(list=code_block_17@L2)
ofRepeatedItem_3 = List.OfRepeatedItem(item=watch_room_name@L1, amount=count_3@L1)
code_block_18 = CodeBlock(a=ofRepeatedItem_3, b=code_block_17) { a + "..." + b; }

watch_7 = Watch(code_block_18)
watch_room_area = Watch(code_block_5)

# group: WM 개수당 개체 복제 후 매칭<Floor>
count_4 = List.Count(list=watch_7@L2)
ofRepeatedItem_4 = List.OfRepeatedItem(item=watch_room_area@L1, amount=count_4@L1)
code_block_19 = CodeBlock(b=watch_7, a=ofRepeatedItem_4) { b + "..." + a; }

watch_8 = Watch(code_block_19)

# group: WM 개수당 개체 복제 후 매칭<Wall>
count_5 = List.Count(list=watch_wm_wall@L2)
ofRepeatedItem_5 = List.OfRepeatedItem(item=watch_6@L1, amount=count_5@L1)
code_block_20 = CodeBlock(a=ofRepeatedItem_5, b=watch_wm_wall) { a + "..." + b; }

# group: WM 개수당 개체 복제 후 매칭<Wall>
count_6 = List.Count(list=code_block_20@L2)
ofRepeatedItem_6 = List.OfRepeatedItem(item=watch_department@L1, amount=count_6@L1)
code_block_21 = CodeBlock(a=ofRepeatedItem_6, b=code_block_20) { a + "..." + b; }

# group: WM 개수당 개체 복제 후 매칭<Wall>
count_7 = List.Count(list=code_block_21@L2)
ofRepeatedItem_7 = List.OfRepeatedItem(item=watch_room_name@L1, amount=count_7@L1)
code_block_22 = CodeBlock(a=ofRepeatedItem_7, b=code_block_21) { a + "..." + b; }

watch_9 = Watch(code_block_22)
watch_room_perimeter = Watch(code_block_7)

# group: WM 개수당 개체 복제 후 매칭<Wall>
count_8 = List.Count(list=watch_9@L2)
ofRepeatedItem_8 = List.OfRepeatedItem(item=watch_room_perimeter@L1, amount=count_8@L1)
code_block_23 = CodeBlock(b=watch_9, a=ofRepeatedItem_8) { b + "..." + a; }

watch_10 = Watch(code_block_23)

# group: WM 개수당 개체 복제 후 매칭<Skirt>
count_9 = List.Count(list=watch_wm_skirt@L2)
ofRepeatedItem_9 = List.OfRepeatedItem(item=watch_6@L1, amount=count_9@L1)
code_block_24 = CodeBlock(a=ofRepeatedItem_9, b=watch_wm_skirt) { a + "..." + b; }

# group: WM 개수당 개체 복제 후 매칭<Skirt>
count_10 = List.Count(list=code_block_24@L2)
ofRepeatedItem_10 = List.OfRepeatedItem(item=watch_department@L1, amount=count_10@L1)
code_block_25 = CodeBlock(a=ofRepeatedItem_10, b=code_block_24) { a + "..." + b; }

# group: WM 개수당 개체 복제 후 매칭<Skirt>
count_11 = List.Count(list=code_block_25@L2)
ofRepeatedItem_11 = List.OfRepeatedItem(item=watch_room_name@L1, amount=count_11@L1)
code_block_26 = CodeBlock(a=ofRepeatedItem_11, b=code_block_25) { a + "..." + b; }

watch_11 = Watch(code_block_26)

# group: WM 개수당 개체 복제 후 매칭<Wall>
count_12 = List.Count(list=watch_11@L2)
ofRepeatedItem_12 = List.OfRepeatedItem(item=watch_room_perimeter@L1, amount=count_12@L1)
code_block_27 = CodeBlock(b=watch_11, a=ofRepeatedItem_12) { b + "..." + a; }

watch_12 = Watch(code_block_27)

# group: WM 개수당 개체 복제 후 매칭<Ceiling>
count_13 = List.Count(list=watch_wm_ceiling@L2)
ofRepeatedItem_13 = List.OfRepeatedItem(item=watch_6@L1, amount=count_13@L1)
code_block_28 = CodeBlock(a=ofRepeatedItem_13, b=watch_wm_ceiling) { a + "..." + b; }

# group: WM 개수당 개체 복제 후 매칭<Ceiling>
count_14 = List.Count(list=code_block_28@L2)
ofRepeatedItem_14 = List.OfRepeatedItem(item=watch_department@L1, amount=count_14@L1)
code_block_29 = CodeBlock(a=ofRepeatedItem_14, b=code_block_28) { a + "..." + b; }

# group: WM 개수당 개체 복제 후 매칭<Ceiling>
count_15 = List.Count(list=code_block_29@L2)
ofRepeatedItem_15 = List.OfRepeatedItem(item=watch_room_name@L1, amount=count_15@L1)
code_block_30 = CodeBlock(a=ofRepeatedItem_15, b=code_block_29) { a + "..." + b; }

watch_13 = Watch(code_block_30)

# group: WM 개수당 개체 복제 후 매칭<Ceiling>
count_16 = List.Count(list=watch_13@L2)
ofRepeatedItem_16 = List.OfRepeatedItem(item=watch_room_area@L1, amount=count_16@L1)
code_block_31 = CodeBlock(b=watch_13, a=ofRepeatedItem_16) { b + "..." + a; }

watch_14 = Watch(code_block_31)
list_create = List.Create(item0=watch_8, item1=watch_10, item2=watch_12, item3=watch_14)
code_block_32 = CodeBlock { "..."; }
split = String.Split(str=list_create, separator0=code_block_32)
code_block_33 = CodeBlock { 2; }
flatten = List.Flatten(list=split, amt=code_block_33)
code_block_34 = CodeBlock(str1=flatten)
# ---------- code_block_34.designscript (4 lines) ----------
t1 =
String.ToNumber(List.GetItemAtIndex(str1@L2<1>, 6))
*
String.ToNumber(List.GetItemAtIndex(str1@L2<1>, 7));
# ----------------------------------------
watch_15 = Watch(code_block_34)
addItemToEnd = List.AddItemToEnd(item=watch_15@L1, list=flatten@L2)

# group: Export Excel(By OpenpyXl)
firstItem_2 = List.FirstItem()  # unwired: list
sortByFunction = List.SortByFunction(list=addItemToEnd, sortFunction=firstItem_2)
python_script_export_excel_by = Python(IN[0]=sortByFunction)  # "Python Script@Export Excel(By OpenpyXl)"; CPython3
# ---------- python_script_export_excel_by.python (151 lines) ----------
# Load the Python Standard and DesignScript Libraries
import sys
import os
#sys.path.append(r'C:\Users\HEC\AppData\Local\Programs\Python\Python39\Lib\site-packages')
#sys.path.append(r'C:\Users\pjmk0\AppData\Local\Programs\Python\Python39\Lib\site-packages')
sys.path.append(os.getenv('LOCALAPPDATA').replace('\\','\\\\') + r'\Programs\Python\Python39\Lib\site-packages')
import clr
clr.AddReference('ProtoGeometry')
from Autodesk.DesignScript.Geometry import *
from collections import Iterable

def iterable(obj):
    return isinstance(obj, Iterable)


# The inputs to this node will be stored as a list in the IN variables.
dataEnteringNode = IN
ListIn = IN[0]

# Place your code below this line
import datetime
from datetime import date, timedelta
Today = date.today()
import openpyxl
from openpyxl.styles import Border, Side, PatternFill, Font, GradientFill, Alignment, Color, numbers

sample_items = ListIn


def write_to_file(filepath):
    wb = openpyxl.Workbook()
    for sheet in wb.sheetnames:
        wb.remove(wb[sheet])

    thin = Side(border_style="thin", color="000000")
    double = Side(border_style="double", color="000000")

    ws = wb.create_sheet(title='Wall_Calc_instance', index=0)

    ws.merge_cells('A1:L1')
    ws['A1'] = 'HEC Bidding Calculation Sheet'
    cell = ws['A1']
    cell.font = openpyxl.styles.Font(color='000000', size=20)
    cell.fill = openpyxl.styles.fills.PatternFill(patternType='solid',
                                                  fgColor=openpyxl.styles.colors.Color(rgb='fff3b0'))

    ws['A2'] = 'Item Number'
    ws['A2'].font = openpyxl.styles.Font(b=True, color='000000', size=12)
    ws['B2'] = 'Room Name'
    ws['B2'].font = openpyxl.styles.Font(b=True, color='000000', size=12)
    ws['C2'] = 'Department'
    ws['C2'].font = openpyxl.styles.Font(b=True, color='000000', size=12)
    ws['D2'] = 'Interior Finish Type'
    ws['D2'].font = openpyxl.styles.Font(b=True, color='000000', size=12)
    ws['E2'] = 'WorkMaster Code'
    ws['E2'].font = openpyxl.styles.Font(b=True, color='000000', size=12)
    ws['F2'] = 'WorkMaster Description'
    ws['F2'].font = openpyxl.styles.Font(b=True, color='000000', size=12)
    ws['G2'] = 'Unit'
    ws['G2'].font = openpyxl.styles.Font(b=True, color='000000', size=12)
    ws['H2'] = '계수'
    ws['H2'].font = openpyxl.styles.Font(b=True, color='000000', size=12)
    ws['I2'] = '계산 참조값'
    ws['I2'].font = openpyxl.styles.Font(b=True, color='000000', size=12)
    ws['J2'] = 'Quantities'
    ws['J2'].font = openpyxl.styles.Font(b=True, color='000000', size=12)
    ws['K2'] = 'Unit Price'
    ws['K2'].font = openpyxl.styles.Font(b=True, color='000000', size=12)
    ws['L2'] = 'Total Price'
    ws['L2'].font = openpyxl.styles.Font(b=True, color='000000', size=12)


## 칼럼별 너비 조정 구간
#    for col in range(ws.max_column):
#        ws.column_dimensions[chr(ord('A') + col)].width = 15
    ws.column_dimensions['A'].width = 15
    ws.column_dimensions['B'].width = 25
    ws.column_dimensions['C'].width = 12
    ws.column_dimensions['D'].width = 20
    ws.column_dimensions['E'].width = 20
    ws.column_dimensions['F'].width = 52
    ws.column_dimensions['G'].width = 9
    #ws.column_dimensions['H'].width = 9
    ws.column_dimensions['H'].hidden = True
    #ws.column_dimensions['I'].width = 12
    ws.column_dimensions['I'].hidden = True
    ws.column_dimensions['J'].width = 12
    ws.column_dimensions['K'].width = 12
    ws.column_dimensions['L'].width = 12

###
    start_row = 3
    for (row, item) in enumerate(sample_items, start_row):
        cell = ws.cell(row=row, column=1, value=row - 2)
        cell.alignment = openpyxl.styles.Alignment(horizontal='center', vertical='center')

#        cell = ws.cell(row=row, column=2, value=item[0])
#        cell.number_format = openpyxl.styles.numbers.FORMAT_DATE_YYYYMMDD2  # 'yyyy-mm-dd'
        ws.cell(row=row, column=2, value=item[0]) ## Room Name 칼럼

        ws.cell(row=row, column=3, value=item[1]) ## Department 칼럼
        
        ws.cell(row=row, column=4, value=item[2]) ## Interior Finish Type 칼럼
        
        ws.cell(row=row, column=5, value=item[3]) ## WorkMaster Code 칼럼
        
        ws.cell(row=row, column=6, value=item[4]) ## WorkMaster Description 칼럼
        
        ws.cell(row=row, column=7, value=item[5]) ## Unit 칼럼

        cell = ws.cell(row=row, column=8, value=item[6]) ## 계수 칼럼
        cell.number_format = openpyxl.styles.numbers.builtin_format_code(3)  # '#,##0'
        
        cell = ws.cell(row=row, column=9, value=item[7]) ## 계산 참조값 칼럼
        cell.number_format = openpyxl.styles.numbers.builtin_format_code(3)  # '#,##0'
        
        cell = ws.cell(row=row, column=10, value=item[8]) ## Quantities 칼럼
        cell.number_format = openpyxl.styles.numbers.builtin_format_code(3)  # '#,##0'
        cell.font = openpyxl.styles.Font(b=True, color='000000', size=11)

        cell = ws.cell(row=row, column=12, value='= J{current_row}*K{current_row}'.format(current_row=cell.row))
        cell.number_format = '#,##0'

#        cell = ws.cell(row=row, column=6, value='= D{current_row} * E{current_row}'.format(current_row=cell.row))
#        cell.number_format = openpyxl.styles.numbers.builtin_format_code(3)

    total_row = ws.max_row + 1
    if total_row > start_row:
        cell1 = ws.cell(row=total_row, column=11, value='Total')
        cell1.font = openpyxl.styles.Font(b=True, color='000000', size=15)
        
        cell2 = ws.cell(row=total_row, column=12, value='= SUM(L{}:L{})'.format(start_row, total_row - 1))
        cell2.number_format = openpyxl.styles.numbers.builtin_format_code(3)
        cell2.border = Border(top=double, left=double, right=double, bottom=double)
        cell2.font = openpyxl.styles.Font(b=True, color='ff03ce', size=15)
    

    wb.save(filepath)
    wb.close()


##if __name__ == '__main__':
#write_to_file('C:\\Users\\pjmk0\\AppData\\Roaming\\test.xlsx')
save_name = "HecBiddingCalcSheet_" + Today.strftime("%Y-%m-%d")+".xlsx"
path = os.getenv('APPDATA').replace('\\','\\\\')
filePath = path + '\\' + save_name

write_to_file(filePath)

# Assign your output to the OUT variable.
OUT = os.getenv('APPDATA')
# ----------------------------------------

code_block_35 = CodeBlock { true; }
exportExcel = Data.ExportExcel(filePath=file_path, sheetName=code_block_9, startRow=code_block_10, startCol=code_block_10, data=sortByFunction, overWrite=code_block_35)  # frozen

# group: All Room Elements
categories_2 = Categories("OST_Rooms")
all_elements_of_category_2 = ElementsOfCategory(Category=categories_2)
parameters_2 = Element.Parameters(element=all_elements_of_category_2)

code_block_36 = CodeBlock { "Name"; "Department"; "Interior Finish"; "Exterior Finish"; }
join = List.Join(list0=code_block_36.out0, list1=code_block_36.out1, list2=code_block_36.out2, list3=code_block_36.out3)
getParameterValueByName_7 = Element.GetParameterValueByName(element=all_elements_of_category_2, parameterName=join, lacing=CrossProduct)

# group: Input_Excel related
file_path_2 = Filename(".\01_Building List_Pilot Project_2021_1206_mk.xlsx")  # graph input
sheet_name = CodeBlock { "Finish Code"; }

# group: Github_Python@Import Excel(By OpenpyXl)
string_from_web = Python()  # CPython3; unwired: IN[0]
# ---------- string_from_web.python (19 lines) ----------
# Load the Python Standard and DesignScript Libraries
import sys
import clr
clr.AddReference('ProtoGeometry')
from Autodesk.DesignScript.Geometry import *
import urllib.request

# The inputs to this node will be stored as a list in the IN variables.
dataEnteringNode = IN
inputURL = "https://raw.githubusercontent.com/HNANmal/mQ/master/Laboratory/20211123_%EC%9E%85%EC%B0%B0%EC%9E%90%EB%8F%99%ED%99%94%ED%88%B4Test%20Sample/test.py"

# Place your code below this line
req = urllib.request
data = req.urlopen(inputURL)

result = data.read().decode("utf-8")

# Assign your output to the OUT variable.
OUT = result
# ----------------------------------------
python_script_from_string = PythonStringNode(script=string_from_web, IN[0]=file_path_2, IN[1]=sheet_name)  # CPython3

# group: Data bunch 분할_Row기반
code_block_37 = CodeBlock { 2; }
dropItems = List.DropItems(list=python_script_from_string, amount=code_block_37)
string_from_object = FromObject(object=dropItems)
firstItem_3 = List.FirstItem(list=string_from_object@L2)
code_block_38 = CodeBlock { "Base Material"; }
contains = String.Contains(str=firstItem_3, searchFor=code_block_38)
code_block_39 = CodeBlock { true; }
allIndicesOf_2 = List.AllIndicesOf(list=contains, item=code_block_39)
python_script_data_bunch_분할_행기반 = Python(IN[0]=allIndicesOf_2)  # CPython3
# ---------- python_script_data_bunch_분할_행기반.python (22 lines) ----------
# Load the Python Standard and DesignScript Libraries
import sys
import clr
clr.AddReference('ProtoGeometry')
from Autodesk.DesignScript.Geometry import *

# The inputs to this node will be stored as a list in the IN variables.
dataEnteringNode = IN
inlist = IN[0]

# Place your code below this line
result = []
for i in range(len(inlist)):
    if i < len(inlist)-1:
        sub = inlist[i+1] - inlist[i]
        result.append(sub)
    else:
        pass


# Assign your output to the OUT variable.
OUT = result
# ----------------------------------------
chop = List.Chop(list=dropItems, lengths=python_script_data_bunch_분할_행기반)

code_block_40 = CodeBlock { 1; }
getItemAtIndex = List.GetItemAtIndex(list=chop@L3, index=code_block_40)
firstItem_4 = List.FirstItem(list=getItemAtIndex@L2)
byKeysValues = DesignScript.Builtin.Dictionary.ByKeysValues(keys=firstItem_4, values=chop)
code_block_41 = CodeBlock { "Roof"; }
valueAtKey_5 = DesignScript.Builtin.Dictionary.ValueAtKey(dictionary=byKeysValues, key=code_block_41)
firstItem_5 = List.FirstItem(list=chop@L3)
code_block_42 = CodeBlock { "Finish"; }
eq = firstItem_5 == code_block_42
code_block_43 = CodeBlock { true; }
allIndicesOf_3 = List.AllIndicesOf(list=eq@L2, item=code_block_43)
flatten_2 = List.Flatten(list=allIndicesOf_3)
uniqueItems_2 = List.UniqueItems(list=flatten_2)
code_block_44 = CodeBlock(i=uniqueItems_2) { i[0]; }
getItemAtIndex_2 = List.GetItemAtIndex(list=valueAtKey_5@L2, index=code_block_44)
code_block_45 = CodeBlock { "RF"; }
contains_2 = String.Contains(str=getItemAtIndex_2, searchFor=code_block_45)
code_block_46 = CodeBlock { true; }
allIndicesOf_4 = List.AllIndicesOf(list=contains_2, item=code_block_46)
getItemAtIndex_3 = List.GetItemAtIndex(list=valueAtKey_5@L3, index=allIndicesOf_4)
code_block_47 = CodeBlock(i=code_block_44) { i; }
dropItems_2 = List.DropItems(list=getItemAtIndex_3@L2, amount=code_block_47)
firstItem_6 = List.FirstItem(list=dropItems_2@L2)
code_block_48 = CodeBlock { 2; }
getItemAtIndex_4 = List.GetItemAtIndex(list=valueAtKey_5@L3, index=code_block_48)
dropItems_3 = List.DropItems(list=getItemAtIndex_4@L2, amount=code_block_47)
flatten_3 = List.Flatten(list=dropItems_3)
string_from_object_2 = FromObject(object=dropItems_2)
code_block_49 = CodeBlock { "O"; }
allIndicesOf_5 = List.AllIndicesOf(list=string_from_object_2@L2, item=code_block_49)
python_script_empty_list_제거 = Python(IN[0]=allIndicesOf_5)  # CPython3
# ---------- python_script_empty_list_제거.python (19 lines) ----------
# Load the Python Standard and DesignScript Libraries
import sys
import clr
clr.AddReference('ProtoGeometry')
from Autodesk.DesignScript.Geometry import *

# The inputs to this node will be stored as a list in the IN variables.
dataEnteringNode = IN

inlist = IN[0]
# Place your code below this line
result = []
for i in inlist:
    if i:
        result.append(i)
    else:
        pass
# Assign your output to the OUT variable.
OUT = result
# ----------------------------------------
getItemAtIndex_5 = List.GetItemAtIndex(list=flatten_3, index=python_script_empty_list_제거@L2)
byKeysValues_2 = DesignScript.Builtin.Dictionary.ByKeysValues(keys=firstItem_6, values=getItemAtIndex_5)
