# Dynamo graph test.dyn (Dynamo 2.10.1.3976)
# packages: GenerativeDesign 1.7.3.0

# group: All Levels Elements
categories = Categories("OST_Levels")
all_elements_of_category = ElementsOfCategory(Category=categories)

# group: All Grids Elements
categories_2 = Categories("OST_Grids")
all_elements_of_category_2 = ElementsOfCategory(Category=categories_2)

python_script = Python(IN[0]=all_elements_of_category, IN[1]=all_elements_of_category_2)  # "Python Script@createGridIntersectPointsDict"; CPython3; unwired: IN[2]
# ---------- python_script.python (84 lines) ----------
# Load the Python Standard and DesignScript Libraries
import sys
import clr
clr.AddReference('ProtoGeometry')
from Autodesk.DesignScript.Geometry import *

clr.AddReference('RevitAPI')
from Autodesk.Revit.DB import *

clr.AddReference("RevitServices")
import RevitServices
from RevitServices.Persistence import DocumentManager
from RevitServices.Transactions import TransactionManager

clr.AddReference("RevitNodes")
import Revit

doc = DocumentManager.Instance.CurrentDBDocument

#crv = Revit.GeometryConversion.RevitToProtoCurve.ToProtoType( crv, true )

# The inputs to this node will be stored as a list in the IN variables.
dataEnteringNode = IN

#alllevels =  FilteredElementCollector(doc).OfClass(Level).WhereElementIsNotElementType().ToElements()

#allgrids = FilteredElementCollector(doc).OfClass(Grid).WhereElementIsNotElementType().ToElements()
alllevels = IN[0]
allgrids = IN[1]

class GridInfo():
    def __init__(self, grid):
        def findDirection(gridVector):
            if gridVector.IsParallel(Vector.XAxis()):
                return "X_axis"
            else:
                return "Y_axis"
        gridName = grid.Name
        self.gridName = gridName
        gridCrv = grid.Curve
        self.gridCrv = gridCrv
        gridVector = gridCrv.Direction.Normalized()
        self.gridVector = gridVector
        direction = findDirection(gridVector)
        self.direction = direction

# Place your code below this line

def createCrossPointsDict(allgrids):
    all_gridInfo = list(map(lambda i: GridInfo(i), allgrids))
    xgridInfo = list(filter(lambda i: i.direction == "X_axis", all_gridInfo))
    ygridInfo = list(filter(lambda i: i.direction == "Y_axis", all_gridInfo))
    def getPtsDict(xgridInfo, ygridInfo):
        _keys = []
        _values = []
        _result = {}
        for i in xgridInfo:
            for j in ygridInfo:
                loc_mark = '-'.join([i.gridName, j.gridName])
                loc_pts = i.gridCrv.Intersect(j.gridCrv)
                _result[loc_mark] = loc_pts
                _keys.append(loc_mark)
                _values.append(loc_pts)
        return [_keys, list(zip(*_values)), _result]

    result = getPtsDict(xgridInfo, ygridInfo)
    return result

def splitGridCurve(gridinfo, pointsDict):
    originCrv = gridinfo.gridCrv
    pts = pointsDict[1][0]
    targetpts = list(filter(lambda i: i.DoesIntersect(originCrv), pts))
    splitCrvs = originCrv.SplitByPoints(targetpts)
    return splitCrvs


pointsDict = createCrossPointsDict(allgrids)
all_gridInfo = list(map(lambda i: GridInfo(i), allgrids))
splitCrvs = list(map(lambda i: splitGridCurve(i, pointsDict), all_gridInfo))


result = [pointsDict, splitCrvs]
# Assign your output to the OUT variable.
OUT = result
# ----------------------------------------

# group: All Splitted Curve
splitted_curve = CodeBlock(i=python_script) { i[1]; }
flatten = List.Flatten(list=splitted_curve)

# group: All Room Elements
categories_3 = Categories("OST_Rooms")
all_elements_of_category_3 = ElementsOfCategory(Category=categories_3)

# group: Create RoomInfo Instances
string_from_web = Python()  # CPython3; unwired: IN[0]
# ---------- string_from_web.python (19 lines) ----------
# Load the Python Standard and DesignScript Libraries
import sys
import clr
clr.AddReference('ProtoGeometry')
from Autodesk.DesignScript.Geometry import *
import urllib.request

# The inputs to this node will be stored as a list in the IN variables.
dataEnteringNode = IN
inputURL = "https://raw.githubusercontent.com/HNANmal/mQ/master/Hdynlib/DataStructure/Custom/Rooms/CreateRoomInfoInstance.py"

# Place your code below this line
req = urllib.request
data = req.urlopen(inputURL)

result = data.read().decode("utf-8")

# Assign your output to the OUT variable.
OUT = result
# ----------------------------------------
string_from_web_2 = Python()  # CPython3; unwired: IN[0]
# ---------- string_from_web_2.python (19 lines) ----------
# Load the Python Standard and DesignScript Libraries
import sys
import clr
clr.AddReference('ProtoGeometry')
from Autodesk.DesignScript.Geometry import *
import urllib.request

# The inputs to this node will be stored as a list in the IN variables.
dataEnteringNode = IN
inputURL = "https://raw.githubusercontent.com/HNANmal/mQ/master/Hdynlib/DataStructure/Custom/Rooms/RoomInfoClass.py"

# Place your code below this line
req = urllib.request
data = req.urlopen(inputURL)

result = data.read().decode("utf-8")

# Assign your output to the OUT variable.
OUT = result
# ----------------------------------------
roominfoclass = PythonStringNode(script=string_from_web_2, IN[1]=all_elements_of_category_3)  # CPython3; unwired: IN[0]
createroominfoinstance = PythonStringNode(script=string_from_web, IN[1]=all_elements_of_category_3, IN[2]=roominfoclass)  # CPython3; unwired: IN[0]
code_block = CodeBlock(i=createroominfoinstance) { i[0]; i[1]; }
roomInfoInstances = CodeBlock(result=code_block.out1) { result; }

# group: 건물 바운더리 생성(GF 기준)
python_script_2 = Python(IN[0]=roomInfoInstances)  # CPython3
# ---------- python_script_2.python (16 lines) ----------
# Load the Python Standard and DesignScript Libraries
import sys
import clr
clr.AddReference('ProtoGeometry')
from Autodesk.DesignScript.Geometry import *

# The inputs to this node will be stored as a list in the IN variables.
dataEnteringNode = IN

inputs = IN[0]

# Place your code below this line

result = list(map(lambda i: i.roombottomface, filter(lambda j: j.level == "GF", inputs)))
# Assign your output to the OUT variable.
OUT = result
# ----------------------------------------
flatten_2 = List.Flatten(list=python_script_2)
byJoinedSurfaces = PolySurface.ByJoinedSurfaces(surfaces=flatten_2)
perimeterCurves = Surface.PerimeterCurves(surface=byJoinedSurfaces)
byJoinedCurves = PolyCurve.ByJoinedCurves(curves=perimeterCurves)

# group: 외곽선 500 오프셋
code_block_2 = CodeBlock { 500; }
offset = Curve.Offset(curve=byJoinedCurves, distance=code_block_2)

# group: 건물 테두리 내부 Splitted Curve 추출
levels = Levels("GF")
elevation = Level.Elevation(level=levels)
translate = Geometry.Translate(geometry=flatten, zTranslation=elevation)
doesIntersect = Geometry.DoesIntersect(geometry=translate, other=offset)
filterByBoolMask = List.FilterByBoolMask(list=translate, mask=doesIntersect)
flatten_3 = List.Flatten(list=filterByBoolMask.out)

# group: 지하층 제외 전체 레벨
string_from_web_3 = Python()  # CPython3; unwired: IN[0]
# ---------- string_from_web_3.python (19 lines) ----------
# Load the Python Standard and DesignScript Libraries
import sys
import clr
clr.AddReference('ProtoGeometry')
from Autodesk.DesignScript.Geometry import *
import urllib.request

# The inputs to this node will be stored as a list in the IN variables.
dataEnteringNode = IN
inputURL = "https://raw.githubusercontent.com/HNANmal/mQ/master/Hdynlib/Revit/Elements/Filtering/FilterElementsExceptTarget.py"

# Place your code below this line
req = urllib.request
data = req.urlopen(inputURL)

result = data.read().decode("utf-8")

# Assign your output to the OUT variable.
OUT = result
# ----------------------------------------
boolean = BoolSelector(false)
code_block_3 = CodeBlock { "B"; }
filterelementsexcepttarget = PythonStringNode(script=string_from_web_3, IN[0]=all_elements_of_category, IN[1]=boolean, IN[2]=code_block_3)  # CPython3

# group: GF 제외 전체 레벨
string_from_web_4 = Python()  # CPython3; unwired: IN[0]; same code as string_from_web_3
boolean_2 = BoolSelector(false)
code_block_4 = CodeBlock { "G"; }
filterelementsexcepttarget_2 = PythonStringNode(script=string_from_web_4, IN[0]=filterelementsexcepttarget, IN[1]=boolean_2, IN[2]=code_block_4)  # CPython3

# group: 층별로 Splitted Curve 복사
elevation_2 = Level.Elevation(level=filterelementsexcepttarget_2)
translate_2 = Geometry.Translate(geometry=flatten_3, zTranslation=elevation_2, lacing=CrossProduct)
transpose = List.Transpose(lists=translate_2)

# group: 빔거더 배치
family_types = FamilyTypes("Concrete-Rectangular-Beam:BM111_400x500_RG1")
beamByCurve = StructuralFraming.BeamByCurve(curve=transpose, level=filterelementsexcepttarget_2, structuralFramingType=family_types, lacing=CrossProduct)
levels_2 = Levels("GF")

code_block_5 = CodeBlock { i; }  # unwired: i

# group: 기둥 생성 구간
structural_column_types = StructuralColumnTypes("CL111_500x500")
code_block_6 = CodeBlock(input=code_block_5) { input; }
flatten_4 = List.Flatten(list=code_block_6)
byPointAndLevel = FamilyInstance.ByPointAndLevel(familyType=structural_column_types, point=flatten_4, level=filterelementsexcepttarget, lacing=CrossProduct)

watch = Watch()  # unwired: arg0
code_block_7 = CodeBlock(i=python_script) { i[0][0]; i[0][1]; i[0][2]; }
valueAtKey = DesignScript.Builtin.Dictionary.ValueAtKey(dictionary=code_block_7.out2, key=code_block_7.out0)
code_block_8 = CodeBlock(i=valueAtKey) { i; }

# group: 패데스탈 배치구간
structural_column_types_2 = StructuralColumnTypes("CL111_500x500")
code_block_9 = CodeBlock(input=code_block_5) { input; }
flatten_5 = List.Flatten(list=code_block_9)
categories_4 = Categories("OST_Levels")
all_elements_of_category_4 = ElementsOfCategory(Category=categories_4)
code_block_10 = CodeBlock(i=all_elements_of_category_4) { i[1]; }
byPointAndLevel_2 = FamilyInstance.ByPointAndLevel(familyType=structural_column_types_2, point=flatten_5, level=code_block_10)

code_block_11 = CodeBlock()  # //RevitMemberCreaterClass
watch_2 = Watch(code_block.out0)
code_block_12 = CodeBlock(i=code_block_7.out1) { i; }

# group: 기초 배치구간
family_types_2 = FamilyTypes("FT112-Footing-Rectangular:FT112_2400x2400x500")
code_block_13 = CodeBlock(input=code_block_5) { input; }
flatten_6 = List.Flatten(list=code_block_13)
categories_5 = Categories("OST_Levels")
all_elements_of_category_5 = ElementsOfCategory(Category=categories_5)
code_block_14 = CodeBlock(i=all_elements_of_category_5) { i[1]; }
byPointAndLevel_3 = FamilyInstance.ByPointAndLevel(familyType=family_types_2, point=flatten_6, level=code_block_14)  # frozen

# group: 외곽선 -500 오프셋
code_block_15 = CodeBlock { -500; }
offset_2 = Curve.Offset(curve=byJoinedCurves, distance=code_block_15)
byPatch = Surface.ByPatch(closedCurve=offset_2)

# group: 건물 외곽 Splitted Curve 추출(TG 용)
doesIntersect_2 = Geometry.DoesIntersect(geometry=flatten_3, other=byPatch)
filterByBoolMask_2 = List.FilterByBoolMask(list=flatten_3, mask=doesIntersect_2)

# group: 해당 층으로 Splitted Curve 복사
levels_3 = Levels("GF")
elevation_3 = Level.Elevation(level=levels_3)
translate_3 = Geometry.Translate(geometry=filterByBoolMask_2.out, zTranslation=elevation_3, lacing=CrossProduct)
transpose_2 = List.Transpose(lists=translate_3)

# group: 타이거더 배치
family_types_3 = FamilyTypes("Concrete-Rectangular-Beam:BM111_400x500_RG1")
beamByCurve_2 = StructuralFraming.BeamByCurve(curve=transpose_2, level=levels_3, structuralFramingType=family_types_3, lacing=CrossProduct)

remember = Data.Remember()  # unwired: arg0
flatten_7 = List.Flatten(list=remember)
code_block_16 = CodeBlock { 0.5; }
pointAtParameter = Surface.PointAtParameter(surface=flatten_7, u=code_block_16, v=code_block_16)
Z = Point.Z(point=pointAtParameter)
round = Math.Round(number=Z)
uniqueItems = List.UniqueItems(list=round)
eq = uniqueItems == Z  # lacing=CrossProduct
filterByBoolMask_3 = List.FilterByBoolMask(list=flatten_7, mask=eq@L2)
watch_3 = Watch(filterByBoolMask_3.in)
perimeterCurves_2 = Surface.PerimeterCurves(surface=watch_3)
byJoinedCurves_2 = PolyCurve.ByJoinedCurves(curves=perimeterCurves_2)
floor_types = FloorTypes("CFS11_Slab RC_T150")
string_from_web_5 = Python()  # CPython3; unwired: IN[0]; same code as string_from_web_3
boolean_3 = BoolSelector(false)
code_block_17 = CodeBlock { "B"; }
filterelementsexcepttarget_3 = PythonStringNode(script=string_from_web_5, IN[0]=all_elements_of_category, IN[1]=boolean_3, IN[2]=code_block_17)  # CPython3
byOutlineTypeAndLevel = Floor.ByOutlineTypeAndLevel(outline=byJoinedCurves_2, floorType=floor_types, level=filterelementsexcepttarget_3)
python_script_3 = Python()  # CPython3; unwired: IN[0]
# ---------- python_script_3.python (16 lines) ----------
# Load the Python Standard and DesignScript Libraries
import sys
import clr
clr.AddReference('ProtoGeometry')
from Autodesk.DesignScript.Geometry import *

# The inputs to this node will be stored as a list in the IN variables.
dataEnteringNode = IN

inputs = IN[0]

# Place your code below this line

result = list(map(lambda i: i.roombottomface, inputs))
# Assign your output to the OUT variable.
OUT = result
# ----------------------------------------
