# Dynamo graph test2.dyn (Dynamo 2.12.0.5650)
# packages: GenerativeDesign 1.10.10.0

remember = Data.Remember()  # unwired: arg0
flatten = List.Flatten(list=remember)
code_block = CodeBlock { 0.5; }
pointAtParameter = Surface.PointAtParameter(surface=flatten, u=code_block, v=code_block)
Z = Point.Z(point=pointAtParameter)
round = Math.Round(number=Z)
uniqueItems = List.UniqueItems(list=round)
eq = uniqueItems == Z  # lacing=CrossProduct
filterByBoolMask = List.FilterByBoolMask(list=flatten, mask=eq@L2)
watch = Watch(filterByBoolMask.in)
perimeterCurves = Surface.PerimeterCurves(surface=watch)
byJoinedCurves = PolyCurve.ByJoinedCurves(curves=perimeterCurves)
floor_types = FloorTypes("CFS11_Slab RC_T150")
string_from_web = Python()  # CPython3; unwired: IN[0]
# ---------- string_from_web.python (19 lines) ----------
# Load the Python Standard and DesignScript Libraries
import sys
import clr
clr.AddReference('ProtoGeometry')
from Autodesk.DesignScript.Geometry import *
import urllib.request

# The inputs to this node will be stored as a list in the IN variables.
dataEnteringNode = IN
inputURL = "https://raw.githubusercontent.com/HNANmal/mQ/master/Hdynlib/Revit/Elements/Filtering/FilterElementsExceptTarget.py"

# Place your code below this line
req = urllib.request
data = req.urlopen(inputURL)

result = data.read().decode("utf-8")

# Assign your output to the OUT variable.
OUT = result
# ----------------------------------------

# group: All Levels Elements
categories = Categories("OST_Levels")
all_elements_of_category = ElementsOfCategory(Category=categories)

boolean = BoolSelector(false)
code_block_2 = CodeBlock { "B"; }
filterelementsexcepttarget = PythonStringNode(script=string_from_web, IN[0]=all_elements_of_category, IN[1]=boolean, IN[2]=code_block_2)  # CPython3
byOutlineTypeAndLevel = Floor.ByOutlineTypeAndLevel(outline=byJoinedCurves, floorType=floor_types, level=filterelementsexcepttarget)

# group: All Room Elements
categories_2 = Categories("OST_Rooms")
all_elements_of_category_2 = ElementsOfCategory(Category=categories_2)

# group: Create RoomInfo Instances
string_from_web_2 = Python()  # CPython3; unwired: IN[0]
# ---------- string_from_web_2.python (19 lines) ----------
# Load the Python Standard and DesignScript Libraries
import sys
import clr
clr.AddReference('ProtoGeometry')
from Autodesk.DesignScript.Geometry import *
import urllib.request

# The inputs to this node will be stored as a list in the IN variables.
dataEnteringNode = IN
inputURL = "https://raw.githubusercontent.com/HNANmal/mQ/master/Hdynlib/DataStructure/Custom/Rooms/CreateRoomInfoInstance.py"

# Place your code below this line
req = urllib.request
data = req.urlopen(inputURL)

result = data.read().decode("utf-8")

# Assign your output to the OUT variable.
OUT = result
# ----------------------------------------
string_from_web_3 = Python()  # CPython3; unwired: IN[0]
# ---------- string_from_web_3.python (19 lines) ----------
# Load the Python Standard and DesignScript Libraries
import sys
import clr
clr.AddReference('ProtoGeometry')
from Autodesk.DesignScript.Geometry import *
import urllib.request

# The inputs to this node will be stored as a list in the IN variables.
dataEnteringNode = IN
inputURL = "https://raw.githubusercontent.com/HNANmal/mQ/master/Hdynlib/DataStructure/Custom/Rooms/RoomInfoClass.py"

# Place your code below this line
req = urllib.request
data = req.urlopen(inputURL)

result = data.read().decode("utf-8")

# Assign your output to the OUT variable.
OUT = result
# ----------------------------------------
roominfoclass = PythonStringNode(script=string_from_web_3, IN[1]=all_elements_of_category_2)  # CPython3; unwired: IN[0]
createroominfoinstance = PythonStringNode(script=string_from_web_2, IN[1]=all_elements_of_category_2, IN[2]=roominfoclass)  # CPython3; unwired: IN[0]
code_block_3 = CodeBlock(i=createroominfoinstance) { i[0]; i[1]; }
roomInfoInstances = CodeBlock(result=code_block_3.out1) { result; }

python_script = Python(IN[0]=roomInfoInstances)  # CPython3
# ---------- python_script.python (16 lines) ----------
# Load the Python Standard and DesignScript Libraries
import sys
import clr
clr.AddReference('ProtoGeometry')
from Autodesk.DesignScript.Geometry import *

# The inputs to this node will be stored as a list in the IN variables.
dataEnteringNode = IN

inputs = IN[0]

# Place your code below this line

result = list(map(lambda i: i.roombottomface, filter(lambda j: j.level == "GF", inputs)))
# Assign your output to the OUT variable.
OUT = result
# ----------------------------------------
flatten_2 = List.Flatten(list=python_script)
byJoinedSurfaces = PolySurface.ByJoinedSurfaces(surfaces=flatten_2)
thicken = Surface.Thicken(surface=byJoinedSurfaces)
categories_3 = Categories("OST_Grids")
all_elements_of_category_3 = ElementsOfCategory(Category=categories_3)
curve = Grid.Curve(grid=all_elements_of_category_3)
watch_2 = Watch(curve)
flatten_3 = List.Flatten(list=watch_2)
intersect = Geometry.Intersect(geometry=thicken, other=flatten_3)
flatten_4 = List.Flatten(list=intersect)
python_script_2 = Python()  # "Python Script@createGridIntersectPointsDict"; CPython3; unwired: IN[0], IN[1], IN[2]
# ---------- python_script_2.python (73 lines) ----------
# Load the Python Standard and DesignScript Libraries
import sys
import clr
clr.AddReference('ProtoGeometry')
from Autodesk.DesignScript.Geometry import *

clr.AddReference('RevitAPI')
from Autodesk.Revit.DB import *

clr.AddReference("RevitServices")
import RevitServices
from RevitServices.Persistence import DocumentManager
from RevitServices.Transactions import TransactionManager

clr.AddReference("RevitNodes")
import Revit

doc = DocumentManager.Instance.CurrentDBDocument

#crv = Revit.GeometryConversion.RevitToProtoCurve.ToProtoType( crv, true )

# The inputs to this node will be stored as a list in the IN variables.
dataEnteringNode = IN

#alllevels =  FilteredElementCollector(doc).OfClass(Level).WhereElementIsNotElementType().ToElements()

#allgrids = FilteredElementCollector(doc).OfClass(Grid).WhereElementIsNotElementType().ToElements()
alllevels = IN[0]
allgrids = IN[1]

class GridInfo():
    def __init__(self, grid):
        def findDirection(gridVector):
            if gridVector.IsParallel(Vector.XAxis()):
                return "X_axis"
            else:
                return "Y_axis"
        gridName = grid.Name
        self.gridName = gridName
        gridCrv = grid.Curve
        self.gridCrv = gridCrv
        gridVector = gridCrv.Direction.Normalized()
        self.gridVector = gridVector
        direction = findDirection(gridVector)
        self.direction = direction

# Place your code below this line

def createCrossPointsDict(allgrids):
    all_gridInfo = list(map(lambda i: GridInfo(i), allgrids))
    xgridInfo = list(filter(lambda i: i.direction == "X_axis", all_gridInfo))
    ygridInfo = list(filter(lambda i: i.direction == "Y_axis", all_gridInfo))
    def getPtsDict(xgridInfo, ygridInfo):
        _keys = []
        _result = {}
        for i in xgridInfo:
            for j in ygridInfo:
                loc_mark = '-'.join([i.gridName, j.gridName])
                loc_pts = i.gridCrv.Intersect(j.gridCrv)
                _result[loc_mark] = loc_pts
                _keys.append(loc_mark)
        return [_keys, _result]

    result = getPtsDict(xgridInfo, ygridInfo)
    return result

def splitGridCurve(grid):
    pass


result = createCrossPointsDict(allgrids)
# Assign your output to the OUT variable.
OUT = result
# ----------------------------------------
code_block_4 = CodeBlock(i=python_script_2) { i[0]; i[1]; }
valueAtKey = DesignScript.Builtin.Dictionary.ValueAtKey(dictionary=code_block_4.out1, key=code_block_4.out0)
code_block_5 = CodeBlock(i=valueAtKey) { i; }
flatten_5 = List.Flatten(list=code_block_5)

# group: 그리드 교차점
watch_3 = Watch(flatten_5)

code_block_6 = CodeBlock(t1=flatten_4, t2=watch_3) { curve1 = Curve.SplitByPoints(t1, t2); }
flatten_6 = List.Flatten(list=code_block_6)
string_from_object = FromObject(object=flatten_6)
uniqueItems_2 = List.UniqueItems(list=string_from_object@L2)
allIndicesOf = List.AllIndicesOf(list=string_from_object, item=uniqueItems_2@L1)
firstItem = List.FirstItem(list=allIndicesOf@L2)
getItemAtIndex = List.GetItemAtIndex(list=flatten_6, index=firstItem)
levels = Levels("GF")
elevation = Level.Elevation(level=levels)
translate = Geometry.Translate(geometry=getItemAtIndex, zTranslation=elevation)
perimeterCurves_2 = Surface.PerimeterCurves(surface=byJoinedSurfaces)
byJoinedCurves_2 = PolyCurve.ByJoinedCurves(curves=perimeterCurves_2)

# group: 외곽선 500 오프셋
code_block_7 = CodeBlock { 500; }
offset = Curve.Offset(curve=byJoinedCurves_2, distance=code_block_7)

doesIntersect = Geometry.DoesIntersect(geometry=translate, other=offset)
filterByBoolMask_2 = List.FilterByBoolMask(list=translate, mask=doesIntersect)
watch_4 = Watch(filterByBoolMask_2.out)
length = Curve.Length(curve=watch_4)
code_block_8 = CodeBlock(a=length) { a<10; }
filterByBoolMask_3 = List.FilterByBoolMask(list=watch_4, mask=code_block_8)
flatten_7 = List.Flatten(list=filterByBoolMask_3.out)
string_from_web_4 = Python()  # CPython3; unwired: IN[0]; same code as string_from_web
string_from_web_5 = Python()  # CPython3; unwired: IN[0]; same code as string_from_web
boolean_2 = BoolSelector(false)
code_block_9 = CodeBlock { "B"; }
filterelementsexcepttarget_2 = PythonStringNode(script=string_from_web_5, IN[0]=all_elements_of_category, IN[1]=boolean_2, IN[2]=code_block_9)  # CPython3
boolean_3 = BoolSelector(false)
code_block_10 = CodeBlock { "G"; }
filterelementsexcepttarget_3 = PythonStringNode(script=string_from_web_4, IN[0]=filterelementsexcepttarget_2, IN[1]=boolean_3, IN[2]=code_block_10)  # CPython3
elevation_2 = Level.Elevation(level=filterelementsexcepttarget_3)
translate_2 = Geometry.Translate(geometry=flatten_7, zTranslation=elevation_2, lacing=CrossProduct)
transpose = List.Transpose(lists=translate_2)

# group: 빔거더 배치
levels_2 = Levels("GF")
family_types = FamilyTypes("Concrete-Rectangular-Beam:BM111_400x500_RG1")
beamByCurve = StructuralFraming.BeamByCurve(curve=transpose, level=filterelementsexcepttarget_3, structuralFramingType=family_types, lacing=CrossProduct)  # frozen

isNull = Object.IsNull(object=beamByCurve)
countFalse = List.CountFalse(list=isNull)
code_block_11 = CodeBlock { i; }  # unwired: i

# group: 기둥 생성 구간
structural_column_types = StructuralColumnTypes("CL111_500x500")
code_block_12 = CodeBlock(input=code_block_11) { input; }
flatten_8 = List.Flatten(list=code_block_12)
byPointAndLevel = FamilyInstance.ByPointAndLevel(familyType=structural_column_types, point=flatten_8, level=filterelementsexcepttarget_2, lacing=CrossProduct)

watch_5 = Watch()  # unwired: arg0

# group: 패데스탈 배치구간
structural_column_types_2 = StructuralColumnTypes("CL111_500x500")
code_block_13 = CodeBlock(input=code_block_11) { input; }
flatten_9 = List.Flatten(list=code_block_13)
categories_4 = Categories("OST_Levels")
all_elements_of_category_4 = ElementsOfCategory(Category=categories_4)
code_block_14 = CodeBlock(i=all_elements_of_category_4) { i[1]; }
byPointAndLevel_2 = FamilyInstance.ByPointAndLevel(familyType=structural_column_types_2, point=flatten_9, level=code_block_14)

code_block_15 = CodeBlock()  # //RevitMemberCreaterClass
watch_6 = Watch(code_block_3.out0)

# group: All Grids Elements
categories_5 = Categories("OST_Grids")
all_elements_of_category_5 = ElementsOfCategory(Category=categories_5)

code_block_16 = CodeBlock(i=code_block_4.out0) { i; }

# group: 기초 배치구간
family_types_2 = FamilyTypes("FT112-Footing-Rectangular:FT112_2400x2400x500")
code_block_17 = CodeBlock(input=code_block_11) { input; }
flatten_10 = List.Flatten(list=code_block_17)
categories_6 = Categories("OST_Levels")
all_elements_of_category_6 = ElementsOfCategory(Category=categories_6)
code_block_18 = CodeBlock(i=all_elements_of_category_6) { i[1]; }
byPointAndLevel_3 = FamilyInstance.ByPointAndLevel(familyType=family_types_2, point=flatten_10, level=code_block_18)  # frozen

python_script_3 = Python()  # CPython3; unwired: IN[0]
# ---------- python_script_3.python (16 lines) ----------
# Load the Python Standard and DesignScript Libraries
import sys
import clr
clr.AddReference('ProtoGeometry')
from Autodesk.DesignScript.Geometry import *

# The inputs to this node will be stored as a list in the IN variables.
dataEnteringNode = IN

inputs = IN[0]

# Place your code below this line

result = list(map(lambda i: i.roombottomface, inputs))
# Assign your output to the OUT variable.
OUT = result
# ----------------------------------------
