# Dynamo graph Instance Placer_rA.dyn "intersectionFinder" (Dynamo 2.10.1.3976)

# group: EXCEL IMPORT
file_path = Filename(".\3_Structural Member Auto Creation_Sample_revised.xlsx")
file_from_path = FileObject(path=file_path)
code_block = CodeBlock { "Str Foundations"; }
boolean = BoolSelector(false)
importExcel = Data.ImportExcel(file=file_from_path, sheetName=code_block, showExcel=boolean)

# group: 그리드 좌표별 패밀리 타입 DICTIONARY화
code_block_2 = CodeBlock { ","; }
code_block_3 = CodeBlock { 1; }
dropItems = List.DropItems(list=importExcel@L2, amount=code_block_3)
code_block_4 = CodeBlock { 1; }
dropItems_2 = List.DropItems(list=dropItems, amount=code_block_4)
code_block_5 = CodeBlock { 0; }
getItemAtIndex = List.GetItemAtIndex(list=dropItems_2@L2, index=code_block_5)
code_block_6 = CodeBlock { 1; }
dropItems_3 = List.DropItems(list=dropItems_2@L2, amount=code_block_6)
isNull = Object.IsNull(object=dropItems_3)
boolean_2 = BoolSelector(false)
allIndicesOf = List.AllIndicesOf(list=isNull@L2, item=boolean_2)
count = List.Count(list=allIndicesOf@L2)
ofRepeatedItem = List.OfRepeatedItem(item=getItemAtIndex, amount=count, lacing=Shortest)
패밀리코드_전체 = CodeBlock(i=dropItems_3) { i; }
getItemAtIndex_2 = List.GetItemAtIndex(list=패밀리코드_전체@L2, index=allIndicesOf@L2)
flatten = List.Flatten(list=getItemAtIndex_2)

code_block_7 = CodeBlock { 1; }
add = allIndicesOf + code_block_7

# group (continued): 그리드 좌표별 패밀리 타입 DICTIONARY화
string_from_object = FromObject(object=add)
list_create = List.Create(item0=ofRepeatedItem, item1=string_from_object)
flatten_2 = List.Flatten(list=list_create@L3)
transpose = List.Transpose(lists=flatten_2)
join = String.Join(separator=code_block_2, string0=transpose)
flatten_3 = List.Flatten(list=join)
byKeysValues = DesignScript.Builtin.Dictionary.ByKeysValues(keys=flatten_3, values=flatten)

# group: GRID 소환 및 X,Y 축 분류
categories = Categories("OST_Grids")
all_elements_of_category = ElementsOfCategory(Category=categories)
curve = Grid.Curve(grid=all_elements_of_category)
direction = Line.Direction(line=curve)
normalized = Vector.Normalized(vector=direction)
uniqueItems = List.UniqueItems(list=normalized)
code_block_8 = CodeBlock(i=uniqueItems) { i[0]; }
isParallel = Vector.IsParallel(vector=code_block_8, other=normalized)
filterByBoolMask = List.FilterByBoolMask(list=all_elements_of_category, mask=isParallel)

# group: 교차점들 그리드 이름으로 DICTIONARY화
code_block_9 = CodeBlock { ","; }
join_2 = String.Join(separator=code_block_9)  # unwired: string0, string1
code_block_10 = CodeBlock { "Name"; }
getParameterValueByName = Element.GetParameterValueByName(element=filterByBoolMask.in, parameterName=code_block_10)
getParameterValueByName_2 = Element.GetParameterValueByName(element=filterByBoolMask.out, parameterName=code_block_10)
cartesianProduct = List.CartesianProduct(combineFunction=join_2, list0=getParameterValueByName, list1=getParameterValueByName_2)
flatten_4 = List.Flatten(list=cartesianProduct)
intersect = Geometry.Intersect(lacing=CrossProduct)  # unwired: geometry, other
curve_2 = Grid.Curve(grid=filterByBoolMask.in)
curve_3 = Grid.Curve(grid=filterByBoolMask.out)
cartesianProduct_2 = List.CartesianProduct(combineFunction=intersect, list0=curve_2, list1=curve_3)
flatten_5 = List.Flatten(list=cartesianProduct_2@L3)
flatten_6 = List.Flatten(list=flatten_5)
byKeysValues_2 = DesignScript.Builtin.Dictionary.ByKeysValues(keys=flatten_4, values=flatten_6)

# group: Family Instance 배치 구간
components = DesignScript.Builtin.Dictionary.Components(dictionary=byKeysValues)
code_block_11 = CodeBlock { "_"; }
split = String.Split(str=components.values, separator0=code_block_11)
firstItem = List.FirstItem(list=split@L2)
byFamilyNameAndTypeName = FamilyType.ByFamilyNameAndTypeName(familyName=firstItem, typeName=components.values)
valueAtKey = DesignScript.Builtin.Dictionary.ValueAtKey(dictionary=byKeysValues_2, key=components.keys)
levels = Levels("Level 3")
byPointAndLevel = FamilyInstance.ByPointAndLevel(familyType=byFamilyNameAndTypeName, point=valueAtKey, level=levels)
