# Dynamo graph Instance Placer_rB.dyn (Dynamo 2.10.1.3976)

file_path = Filename(".\3_Structural Member Auto Creation_Sample_revised.xlsx")

# group: EXCEL IMPORT
file_from_path = FileObject(path=file_path)
code_block = CodeBlock { "Str Foundations"; }
boolean = BoolSelector(false)
importExcel = Data.ImportExcel(file=file_from_path, sheetName=code_block, showExcel=boolean)

# group: GRID 소환 및 X,Y 축 분류
categories = Categories("OST_Grids")
all_elements_of_category = ElementsOfCategory(Category=categories)
curve = Grid.Curve(grid=all_elements_of_category)
direction = Line.Direction(line=curve)
normalized = Vector.Normalized(vector=direction)
uniqueItems = List.UniqueItems(list=normalized)
code_block_2 = CodeBlock(i=uniqueItems) { i[0]; }
isParallel = Vector.IsParallel(vector=code_block_2, other=normalized)
filterByBoolMask = List.FilterByBoolMask(list=all_elements_of_category, mask=isParallel)

# group: 교차점들 그리드 이름으로 DICTIONARY화
code_block_3 = CodeBlock { ","; }
join = String.Join(separator=code_block_3)  # unwired: string0, string1
code_block_4 = CodeBlock { "Name"; }
getParameterValueByName = Element.GetParameterValueByName(element=filterByBoolMask.in, parameterName=code_block_4)
getParameterValueByName_2 = Element.GetParameterValueByName(element=filterByBoolMask.out, parameterName=code_block_4)
cartesianProduct = List.CartesianProduct(combineFunction=join, list0=getParameterValueByName, list1=getParameterValueByName_2)
flatten = List.Flatten(list=cartesianProduct)
intersect = Geometry.Intersect(lacing=CrossProduct)  # unwired: geometry, other
curve_2 = Grid.Curve(grid=filterByBoolMask.in)
curve_3 = Grid.Curve(grid=filterByBoolMask.out)
cartesianProduct_2 = List.CartesianProduct(combineFunction=intersect, list0=curve_2, list1=curve_3)
flatten_2 = List.Flatten(list=cartesianProduct_2@L3)
flatten_3 = List.Flatten(list=flatten_2)
byKeysValues = DesignScript.Builtin.Dictionary.ByKeysValues(keys=flatten, values=flatten_3)

# group: 그리드 좌표별 패밀리 타입 DICTIONARY화
code_block_5 = CodeBlock { ","; }
code_block_6 = CodeBlock { 1; }
dropItems = List.DropItems(list=importExcel@L2, amount=code_block_6)
code_block_7 = CodeBlock { 1; }
dropItems_2 = List.DropItems(list=dropItems, amount=code_block_7)
code_block_8 = CodeBlock { 0; }
getItemAtIndex = List.GetItemAtIndex(list=dropItems_2@L2, index=code_block_8)
code_block_9 = CodeBlock { 1; }
dropItems_3 = List.DropItems(list=dropItems_2@L2, amount=code_block_9)
isNull = Object.IsNull(object=dropItems_3)
boolean_2 = BoolSelector(false)
allIndicesOf = List.AllIndicesOf(list=isNull@L2, item=boolean_2)
count = List.Count(list=allIndicesOf@L2)
ofRepeatedItem = List.OfRepeatedItem(item=getItemAtIndex, amount=count, lacing=Shortest)
code_block_10 = CodeBlock { 1; }
add = allIndicesOf + code_block_10
string_from_object = FromObject(object=add)
list_create = List.Create(item0=ofRepeatedItem, item1=string_from_object)
flatten_4 = List.Flatten(list=list_create@L3)
transpose = List.Transpose(lists=flatten_4)
join_2 = String.Join(separator=code_block_5, string0=transpose)
flatten_5 = List.Flatten(list=join_2)
패밀리코드_전체 = CodeBlock(i=dropItems_3) { i; }
getItemAtIndex_2 = List.GetItemAtIndex(list=패밀리코드_전체@L2, index=allIndicesOf@L2)
flatten_6 = List.Flatten(list=getItemAtIndex_2)
byKeysValues_2 = DesignScript.Builtin.Dictionary.ByKeysValues(keys=flatten_5, values=flatten_6)
code_block_11 = CodeBlock(dict_byGridName=byKeysValues) { dict_byGridName; }

# group: Family Instance 배치 구간
components = DesignScript.Builtin.Dictionary.Components(dictionary=byKeysValues_2)  # frozen
byName = FamilyType.ByName(name=components.values)
valueAtKey = DesignScript.Builtin.Dictionary.ValueAtKey(dictionary=code_block_11, key=components.keys)
levels = Levels("Level 3")
byPointAndLevel = FamilyInstance.ByPointAndLevel(familyType=byName, point=valueAtKey, level=levels)

byName_2 = FamilyType.ByName(name=components.values)
uniqueItems_2 = List.UniqueItems(list=byName_2)

# group: EXCEL IMPORT
file_from_path_2 = FileObject(path=file_path)
code_block_12 = CodeBlock { "Str Pedestal"; }
boolean_3 = BoolSelector(false)
importExcel_2 = Data.ImportExcel(file=file_from_path_2, sheetName=code_block_12, showExcel=boolean_3)

# group: 그리드 좌표별 패밀리 타입 DICTIONARY화
code_block_13 = CodeBlock { ","; }
code_block_14 = CodeBlock { 1; }
dropItems_4 = List.DropItems(list=importExcel_2@L2, amount=code_block_14)
code_block_15 = CodeBlock { 1; }
dropItems_5 = List.DropItems(list=dropItems_4, amount=code_block_15)
code_block_16 = CodeBlock { 0; }
getItemAtIndex_3 = List.GetItemAtIndex(list=dropItems_5@L2, index=code_block_16)
code_block_17 = CodeBlock { 1; }
dropItems_6 = List.DropItems(list=dropItems_5@L2, amount=code_block_17)
isNull_2 = Object.IsNull(object=dropItems_6)
boolean_4 = BoolSelector(false)
allIndicesOf_2 = List.AllIndicesOf(list=isNull_2@L2, item=boolean_4)
count_2 = List.Count(list=allIndicesOf_2@L2)
ofRepeatedItem_2 = List.OfRepeatedItem(item=getItemAtIndex_3, amount=count_2, lacing=Shortest)
code_block_18 = CodeBlock { 1; }
add_2 = allIndicesOf_2 + code_block_18
string_from_object_2 = FromObject(object=add_2)
list_create_2 = List.Create(item0=ofRepeatedItem_2, item1=string_from_object_2)
flatten_7 = List.Flatten(list=list_create_2@L3)
transpose_2 = List.Transpose(lists=flatten_7)
join_3 = String.Join(separator=code_block_13, string0=transpose_2)
flatten_8 = List.Flatten(list=join_3)
패밀리코드_전체_2 = CodeBlock(i=dropItems_6) { i; }
getItemAtIndex_4 = List.GetItemAtIndex(list=패밀리코드_전체_2@L2, index=allIndicesOf_2@L2)
flatten_9 = List.Flatten(list=getItemAtIndex_4)
byKeysValues_3 = DesignScript.Builtin.Dictionary.ByKeysValues(keys=flatten_8, values=flatten_9)
code_block_19 = CodeBlock(dict_byGridName=byKeysValues) { dict_byGridName; }

# group: Family Instance 배치 구간
components_2 = DesignScript.Builtin.Dictionary.Components(dictionary=byKeysValues_3)  # frozen
byName_3 = FamilyType.ByName(name=components_2.values)
valueAtKey_2 = DesignScript.Builtin.Dictionary.ValueAtKey(dictionary=code_block_19, key=components_2.keys)
levels_2 = Levels("Level 3")
byPointAndLevel_2 = FamilyInstance.ByPointAndLevel(familyType=byName_3, point=valueAtKey_2, level=levels_2)

code_block_20 = CodeBlock { "Base Offset"; }
code_block_21 = CodeBlock { "Foundation Thickness"; }
getParameterValueByName_3 = Element.GetParameterValueByName(element=byName_2, parameterName=code_block_21)
setParameterByName = Element.SetParameterByName(element=byPointAndLevel_2, parameterName=code_block_20, value=getParameterValueByName_3)
code_block_22 = CodeBlock { "Foundation Thickness"; }
byPoint = FamilyInstance.ByPoint()  # unwired: familyType, point

# group: EXCEL IMPORT
file_from_path_3 = FileObject(path=file_path)
code_block_23 = CodeBlock { "Str Framing"; }
boolean_5 = BoolSelector(false)
importExcel_3 = Data.ImportExcel(file=file_from_path_3, sheetName=code_block_23, showExcel=boolean_5)

# group: 그리드 좌표별 패밀리 타입 DICTIONARY화
code_block_24 = CodeBlock { ","; }
code_block_25 = CodeBlock { 1; }
dropItems_7 = List.DropItems(list=importExcel_3@L2, amount=code_block_25)  # frozen
code_block_26 = CodeBlock { 1; }
dropItems_8 = List.DropItems(list=dropItems_7, amount=code_block_26)
code_block_27 = CodeBlock { 0; }
getItemAtIndex_5 = List.GetItemAtIndex(list=dropItems_8@L2, index=code_block_27)
code_block_28 = CodeBlock { 1; }
dropItems_9 = List.DropItems(list=dropItems_8@L2, amount=code_block_28)
isNull_3 = Object.IsNull(object=dropItems_9)
boolean_6 = BoolSelector(false)
allIndicesOf_3 = List.AllIndicesOf(list=isNull_3@L2, item=boolean_6)
count_3 = List.Count(list=allIndicesOf_3@L2)
ofRepeatedItem_3 = List.OfRepeatedItem(item=getItemAtIndex_5, amount=count_3, lacing=Shortest)
code_block_29 = CodeBlock { 1; }
add_3 = allIndicesOf_3 + code_block_29
string_from_object_3 = FromObject(object=add_3)
list_create_3 = List.Create(item0=ofRepeatedItem_3, item1=string_from_object_3)
flatten_10 = List.Flatten(list=list_create_3@L3)
transpose_3 = List.Transpose(lists=flatten_10)
join_4 = String.Join(separator=code_block_24, string0=transpose_3)
flatten_11 = List.Flatten(list=join_4)
패밀리코드_전체_3 = CodeBlock(i=dropItems_9) { i; }
getItemAtIndex_6 = List.GetItemAtIndex(list=패밀리코드_전체_3@L2, index=allIndicesOf_3@L2)
flatten_12 = List.Flatten(list=getItemAtIndex_6)
byKeysValues_4 = DesignScript.Builtin.Dictionary.ByKeysValues(keys=flatten_11, values=flatten_12)
code_block_30 = CodeBlock(dict_byGridName=byKeysValues) { dict_byGridName; }

# group: Family Instance 배치 구간
components_3 = DesignScript.Builtin.Dictionary.Components(dictionary=byKeysValues_4)
byName_4 = FamilyType.ByName(name=components_3.values)
valueAtKey_3 = DesignScript.Builtin.Dictionary.ValueAtKey(dictionary=code_block_30, key=components_3.keys)
levels_3 = Levels("Level 3")
byPointAndLevel_3 = FamilyInstance.ByPointAndLevel(familyType=byName_4, point=valueAtKey_3, level=levels_3)  # frozen

code_block_31 = CodeBlock { "Base Offset"; }
maximumItem = List.MaximumItem()  # unwired: list
setParameterByName_2 = Element.SetParameterByName(element=byPointAndLevel_3, parameterName=code_block_31, value=maximumItem)
transpose_4 = List.Transpose(lists=importExcel_3)
code_block_32 = CodeBlock { ","; }
code_block_33 = CodeBlock { "A"; "1~2"; }
code_block_34 = CodeBlock { "~"; }
split = String.Split(str=code_block_33.out1, separator0=code_block_34)
count_4 = List.Count(list=split)
ofRepeatedItem_4 = List.OfRepeatedItem(item=code_block_33.out0, amount=count_4)
list_create_4 = List.Create(item0=ofRepeatedItem_4, item1=split)
transpose_5 = List.Transpose(lists=list_create_4)
join_5 = String.Join(separator=code_block_32, string0=transpose_5)
valueAtKey_4 = DesignScript.Builtin.Dictionary.ValueAtKey(dictionary=code_block_30, key=join_5)
firstItem = List.FirstItem(list=valueAtKey_4@L2)
lastItem = List.LastItem(list=valueAtKey_4@L2)
byStartPointEndPoint = Line.ByStartPointEndPoint(startPoint=firstItem, endPoint=lastItem)
levels_4 = Levels("Level 1")
code_block_35 = CodeBlock { "BM111_400x600"; }
byName_5 = FamilyType.ByName(name=code_block_35)
beamByCurve = StructuralFraming.BeamByCurve(curve=byStartPointEndPoint, level=levels_4, structuralFramingType=byName_5)  # frozen
code_block_36 = CodeBlock(dict_byGridName=byKeysValues) { dict_byGridName; }

# group: 그리드(세로방향)별 패밀리 타입
restOfItems = List.RestOfItems(list=importExcel_3)
code_block_37 = CodeBlock(i=importExcel_3) { i[0]; }
string_from_object_4 = FromObject(object=code_block_37)
code_block_38 = CodeBlock { "."; }
split_2 = String.Split(str=string_from_object_4, separator0=code_block_38)
firstItem_2 = List.FirstItem(list=split_2@L2)
restOfItems_2 = List.RestOfItems(list=firstItem_2)
restOfItems_3 = List.RestOfItems(list=restOfItems@L2)
byKeysValues_5 = DesignScript.Builtin.Dictionary.ByKeysValues(keys=restOfItems_2, values=restOfItems_3@L2)

firstItem_3 = List.FirstItem(list=restOfItems@L2)
components_4 = DesignScript.Builtin.Dictionary.Components(dictionary=byKeysValues_5)
isNull_4 = Object.IsNull(object=components_4.values@L2)
code_block_39 = CodeBlock { true; }
allIndicesOf_4 = List.AllIndicesOf(list=isNull_4@L2, item=code_block_39)
getItemAtIndex_7 = List.GetItemAtIndex(list=components_4.keys@L2, index=allIndicesOf_4@L2)
removeKeys = DesignScript.Builtin.Dictionary.RemoveKeys(dictionary=byKeysValues_5, keys=getItemAtIndex_7@L2, lacing=Shortest)
string_from_object_5 = FromObject(object=removeKeys)
code_block_40 = CodeBlock { "{}"; }
allIndicesOf_5 = List.AllIndicesOf(list=string_from_object_5, item=code_block_40)
removeItemAtIndex = List.RemoveItemAtIndex(list=removeKeys, indices=allIndicesOf_5)
byKeysValues_6 = DesignScript.Builtin.Dictionary.ByKeysValues(keys=firstItem_3, values=removeItemAtIndex)

# group: grid/ grid 사이 분류
components_5 = DesignScript.Builtin.Dictionary.Components(dictionary=byKeysValues_6)
sort = List.Sort(list=components_5.keys)
code_block_41 = CodeBlock { "~"; }
contains = String.Contains(str=sort, searchFor=code_block_41)
filterByBoolMask_2 = List.FilterByBoolMask(list=sort, mask=contains)

code_block_42 = CodeBlock { "~"; }
split_3 = String.Split(str=filterByBoolMask_2.in, separator0=code_block_42)
valueAtKey_5 = DesignScript.Builtin.Dictionary.ValueAtKey(dictionary=byKeysValues_6, key=filterByBoolMask_2.in)

# group: 시점
code_block_43 = CodeBlock { ","; }
firstItem_4 = List.FirstItem(list=split_3@L2)
keys = DesignScript.Builtin.Dictionary.Keys(dictionary=valueAtKey_5)
count_5 = List.Count(list=keys@L2)
ofRepeatedItem_5 = List.OfRepeatedItem(item=firstItem_4@L1, amount=count_5@L1)
list_create_5 = List.Create(item0=ofRepeatedItem_5, item1=keys)
transpose_6 = List.Transpose(lists=list_create_5)
transpose_7 = List.Transpose(lists=transpose_6@L3)
join_6 = String.Join(separator=code_block_43, string0=transpose_7@L2)

valueAtKey_6 = DesignScript.Builtin.Dictionary.ValueAtKey(dictionary=code_block_36, key=join_6)

# group: 종점
code_block_44 = CodeBlock { ","; }
lastItem_2 = List.LastItem(list=split_3@L2)
keys_2 = DesignScript.Builtin.Dictionary.Keys(dictionary=valueAtKey_5)
count_6 = List.Count(list=keys_2@L2)
ofRepeatedItem_6 = List.OfRepeatedItem(item=lastItem_2@L1, amount=count_6@L1)
list_create_6 = List.Create(item0=ofRepeatedItem_6, item1=keys_2)
transpose_8 = List.Transpose(lists=list_create_6)
transpose_9 = List.Transpose(lists=transpose_8@L3)
join_7 = String.Join(separator=code_block_44, string0=transpose_9@L2)

valueAtKey_7 = DesignScript.Builtin.Dictionary.ValueAtKey(dictionary=code_block_36, key=join_7)
byStartPointEndPoint_2 = Line.ByStartPointEndPoint(startPoint=valueAtKey_6, endPoint=valueAtKey_7, lacing=Shortest)
valueAtKey_8 = DesignScript.Builtin.Dictionary.ValueAtKey(dictionary=byKeysValues_6, key=filterByBoolMask_2.out)
