# Dynamo graph Instance Placer_rC.dyn (Dynamo 2.10.1.3976)

# group: for T/G

file_path = Filename(".\3_Structural Member Auto Creation_Sample_revised.xlsx")

# group: EXCEL IMPORT
file_from_path = FileObject(path=file_path)
code_block = CodeBlock { "Str Foundations"; }
boolean = BoolSelector(false)
importExcel = Data.ImportExcel(file=file_from_path, sheetName=code_block, showExcel=boolean)

# group: GRID 소환 및 X,Y 축 분류
categories = Categories("OST_Grids")
all_elements_of_category = ElementsOfCategory(Category=categories)
curve = Grid.Curve(grid=all_elements_of_category)
direction = Line.Direction(line=curve)
normalized = Vector.Normalized(vector=direction)
uniqueItems = List.UniqueItems(list=normalized)
code_block_2 = CodeBlock(i=uniqueItems) { i[0]; }
isParallel = Vector.IsParallel(vector=code_block_2, other=normalized)
filterByBoolMask = List.FilterByBoolMask(list=all_elements_of_category, mask=isParallel)

# group: 교차점들 그리드 이름으로 DICTIONARY화
code_block_3 = CodeBlock { ","; }
join = String.Join(separator=code_block_3)  # unwired: string0, string1
code_block_4 = CodeBlock { "Name"; }
getParameterValueByName = Element.GetParameterValueByName(element=filterByBoolMask.in, parameterName=code_block_4)
getParameterValueByName_2 = Element.GetParameterValueByName(element=filterByBoolMask.out, parameterName=code_block_4)
cartesianProduct = List.CartesianProduct(combineFunction=join, list0=getParameterValueByName, list1=getParameterValueByName_2)
flatten = List.Flatten(list=cartesianProduct)
intersect = Geometry.Intersect(lacing=CrossProduct)  # unwired: geometry, other
curve_2 = Grid.Curve(grid=filterByBoolMask.in)
curve_3 = Grid.Curve(grid=filterByBoolMask.out)
cartesianProduct_2 = List.CartesianProduct(combineFunction=intersect, list0=curve_2, list1=curve_3)
flatten_2 = List.Flatten(list=cartesianProduct_2@L3)
flatten_3 = List.Flatten(list=flatten_2)
byKeysValues = DesignScript.Builtin.Dictionary.ByKeysValues(keys=flatten, values=flatten_3)

# group: 그리드 좌표별 패밀리 타입 DICTIONARY화-for FDN
code_block_5 = CodeBlock { ","; }
code_block_6 = CodeBlock { 1; }
dropItems = List.DropItems(list=importExcel@L2, amount=code_block_6)
code_block_7 = CodeBlock { 1; }
dropItems_2 = List.DropItems(list=dropItems, amount=code_block_7)
code_block_8 = CodeBlock { 0; }
getItemAtIndex = List.GetItemAtIndex(list=dropItems_2@L2, index=code_block_8)
code_block_9 = CodeBlock { 1; }
dropItems_3 = List.DropItems(list=dropItems_2@L2, amount=code_block_9)
isNull = Object.IsNull(object=dropItems_3)
boolean_2 = BoolSelector(false)
allIndicesOf = List.AllIndicesOf(list=isNull@L2, item=boolean_2)
count = List.Count(list=allIndicesOf@L2)
ofRepeatedItem = List.OfRepeatedItem(item=getItemAtIndex, amount=count, lacing=Shortest)
code_block_10 = CodeBlock { 1; }
add = allIndicesOf + code_block_10
string_from_object = FromObject(object=add)
list_create = List.Create(item0=ofRepeatedItem, item1=string_from_object)
flatten_4 = List.Flatten(list=list_create@L3)
transpose = List.Transpose(lists=flatten_4)
join_2 = String.Join(separator=code_block_5, string0=transpose)
flatten_5 = List.Flatten(list=join_2)
패밀리코드_전체 = CodeBlock(i=dropItems_3) { i; }
getItemAtIndex_2 = List.GetItemAtIndex(list=패밀리코드_전체@L2, index=allIndicesOf@L2)
flatten_6 = List.Flatten(list=getItemAtIndex_2)
byKeysValues_2 = DesignScript.Builtin.Dictionary.ByKeysValues(keys=flatten_5, values=flatten_6)
code_block_11 = CodeBlock(dict_byGridName=byKeysValues) { dict_byGridName; }

# group: Family Instance 배치 구간
components = DesignScript.Builtin.Dictionary.Components(dictionary=byKeysValues_2)
byName = FamilyType.ByName(name=components.values)
valueAtKey = DesignScript.Builtin.Dictionary.ValueAtKey(dictionary=code_block_11, key=components.keys)
levels = Levels("Level 3")
byPointAndLevel = FamilyInstance.ByPointAndLevel(familyType=byName, point=valueAtKey, level=levels)

byName_2 = FamilyType.ByName(name=components.values)
uniqueItems_2 = List.UniqueItems(list=byName_2)

# group: EXCEL IMPORT
file_from_path_2 = FileObject(path=file_path)
code_block_12 = CodeBlock { "Str Pedestal"; }
boolean_3 = BoolSelector(false)
importExcel_2 = Data.ImportExcel(file=file_from_path_2, sheetName=code_block_12, showExcel=boolean_3)

# group: 그리드 좌표별 패밀리 타입 DICTIONARY화-for Pedestal
code_block_13 = CodeBlock { ","; }
code_block_14 = CodeBlock { 1; }
dropItems_4 = List.DropItems(list=importExcel_2@L2, amount=code_block_14)
code_block_15 = CodeBlock { 1; }
dropItems_5 = List.DropItems(list=dropItems_4, amount=code_block_15)
code_block_16 = CodeBlock { 0; }
getItemAtIndex_3 = List.GetItemAtIndex(list=dropItems_5@L2, index=code_block_16)
code_block_17 = CodeBlock { 1; }
dropItems_6 = List.DropItems(list=dropItems_5@L2, amount=code_block_17)
isNull_2 = Object.IsNull(object=dropItems_6)
boolean_4 = BoolSelector(false)
allIndicesOf_2 = List.AllIndicesOf(list=isNull_2@L2, item=boolean_4)
count_2 = List.Count(list=allIndicesOf_2@L2)
ofRepeatedItem_2 = List.OfRepeatedItem(item=getItemAtIndex_3, amount=count_2, lacing=Shortest)
code_block_18 = CodeBlock { 1; }
add_2 = allIndicesOf_2 + code_block_18
string_from_object_2 = FromObject(object=add_2)
list_create_2 = List.Create(item0=ofRepeatedItem_2, item1=string_from_object_2)
flatten_7 = List.Flatten(list=list_create_2@L3)
transpose_2 = List.Transpose(lists=flatten_7)
join_3 = String.Join(separator=code_block_13, string0=transpose_2)
flatten_8 = List.Flatten(list=join_3)
패밀리코드_전체_2 = CodeBlock(i=dropItems_6) { i; }
getItemAtIndex_4 = List.GetItemAtIndex(list=패밀리코드_전체_2@L2, index=allIndicesOf_2@L2)
flatten_9 = List.Flatten(list=getItemAtIndex_4)
byKeysValues_3 = DesignScript.Builtin.Dictionary.ByKeysValues(keys=flatten_8, values=flatten_9)
code_block_19 = CodeBlock(dict_byGridName=byKeysValues) { dict_byGridName; }

# group: Family Instance 배치 구간
components_2 = DesignScript.Builtin.Dictionary.Components(dictionary=byKeysValues_3)
byName_3 = FamilyType.ByName(name=components_2.values)
valueAtKey_2 = DesignScript.Builtin.Dictionary.ValueAtKey(dictionary=code_block_19, key=components_2.keys)
levels_2 = Levels("Level 3")
byPointAndLevel_2 = FamilyInstance.ByPointAndLevel(familyType=byName_3, point=valueAtKey_2, level=levels_2)

byKeysValues_4 = DesignScript.Builtin.Dictionary.ByKeysValues(keys=components_2.keys, values=byPointAndLevel_2)
components_3 = DesignScript.Builtin.Dictionary.Components(dictionary=byKeysValues_2)
valueAtKey_3 = DesignScript.Builtin.Dictionary.ValueAtKey(dictionary=byKeysValues_4, key=components_3.keys)
code_block_20 = CodeBlock { "Base Offset"; }
code_block_21 = CodeBlock { "Foundation Thickness"; }
getParameterValueByName_3 = Element.GetParameterValueByName(element=byName_2, parameterName=code_block_21)
setParameterByName = Element.SetParameterByName(element=valueAtKey_3, parameterName=code_block_20, value=getParameterValueByName_3)

# group: EXCEL IMPORT
file_from_path_3 = FileObject(path=file_path)
code_block_22 = CodeBlock { "Str Framing"; }
boolean_5 = BoolSelector(false)
importExcel_3 = Data.ImportExcel(file=file_from_path_3, sheetName=code_block_22, showExcel=boolean_5)

transpose_3 = List.Transpose(lists=importExcel_3)
code_block_23 = CodeBlock(dict_byGridName=byKeysValues) { dict_byGridName; }

# group: 그리드(세로방향)별 패밀리 타입
restOfItems = List.RestOfItems(list=importExcel_3)
code_block_24 = CodeBlock(i=importExcel_3) { i[0]; }
string_from_object_3 = FromObject(object=code_block_24)
code_block_25 = CodeBlock { "."; }
split = String.Split(str=string_from_object_3, separator0=code_block_25)
firstItem = List.FirstItem(list=split@L2)
restOfItems_2 = List.RestOfItems(list=firstItem)
restOfItems_3 = List.RestOfItems(list=restOfItems@L2)
byKeysValues_5 = DesignScript.Builtin.Dictionary.ByKeysValues(keys=restOfItems_2, values=restOfItems_3@L2)

firstItem_2 = List.FirstItem(list=restOfItems@L2)
components_4 = DesignScript.Builtin.Dictionary.Components(dictionary=byKeysValues_5)
isNull_3 = Object.IsNull(object=components_4.values@L2)
code_block_26 = CodeBlock { true; }
allIndicesOf_3 = List.AllIndicesOf(list=isNull_3@L2, item=code_block_26)
getItemAtIndex_5 = List.GetItemAtIndex(list=components_4.keys@L2, index=allIndicesOf_3@L2)
removeKeys = DesignScript.Builtin.Dictionary.RemoveKeys(dictionary=byKeysValues_5, keys=getItemAtIndex_5@L2, lacing=Shortest)
string_from_object_4 = FromObject(object=removeKeys)
code_block_27 = CodeBlock { "{}"; }
allIndicesOf_4 = List.AllIndicesOf(list=string_from_object_4, item=code_block_27)
removeItemAtIndex = List.RemoveItemAtIndex(list=firstItem_2, indices=allIndicesOf_4)
removeItemAtIndex_2 = List.RemoveItemAtIndex(list=removeKeys, indices=allIndicesOf_4)
byKeysValues_6 = DesignScript.Builtin.Dictionary.ByKeysValues(keys=removeItemAtIndex, values=removeItemAtIndex_2)

# group: grid/ grid 사이 분류
components_5 = DesignScript.Builtin.Dictionary.Components(dictionary=byKeysValues_6)
sort = List.Sort(list=components_5.keys)
code_block_28 = CodeBlock { "~"; }
contains = String.Contains(str=sort, searchFor=code_block_28)
filterByBoolMask_2 = List.FilterByBoolMask(list=sort, mask=contains)

code_block_29 = CodeBlock { "~"; }
split_2 = String.Split(str=filterByBoolMask_2.in, separator0=code_block_29)
valueAtKey_4 = DesignScript.Builtin.Dictionary.ValueAtKey(dictionary=byKeysValues_6, key=filterByBoolMask_2.in)

# group: 시점
code_block_30 = CodeBlock { ","; }
firstItem_3 = List.FirstItem(list=split_2@L2)
keys = DesignScript.Builtin.Dictionary.Keys(dictionary=valueAtKey_4)
count_3 = List.Count(list=keys@L2)
ofRepeatedItem_3 = List.OfRepeatedItem(item=firstItem_3@L1, amount=count_3@L1)
list_create_3 = List.Create(item0=ofRepeatedItem_3, item1=keys)
transpose_4 = List.Transpose(lists=list_create_3)
transpose_5 = List.Transpose(lists=transpose_4@L3)
join_4 = String.Join(separator=code_block_30, string0=transpose_5@L2)

valueAtKey_5 = DesignScript.Builtin.Dictionary.ValueAtKey(dictionary=code_block_23, key=join_4)

# group: 종점
code_block_31 = CodeBlock { ","; }
lastItem = List.LastItem(list=split_2@L2)
keys_2 = DesignScript.Builtin.Dictionary.Keys(dictionary=valueAtKey_4)
count_4 = List.Count(list=keys_2@L2)
ofRepeatedItem_4 = List.OfRepeatedItem(item=lastItem@L1, amount=count_4@L1)
list_create_4 = List.Create(item0=ofRepeatedItem_4, item1=keys_2)
transpose_6 = List.Transpose(lists=list_create_4)
transpose_7 = List.Transpose(lists=transpose_6@L3)
join_5 = String.Join(separator=code_block_31, string0=transpose_7@L2)

valueAtKey_6 = DesignScript.Builtin.Dictionary.ValueAtKey(dictionary=code_block_23, key=join_5)
byStartPointEndPoint = Line.ByStartPointEndPoint(startPoint=valueAtKey_5, endPoint=valueAtKey_6, lacing=Shortest)
levels_3 = Levels("Level 1")
valueAtKey_7 = DesignScript.Builtin.Dictionary.ValueAtKey(dictionary=byKeysValues_6, key=filterByBoolMask_2.in)
components_6 = DesignScript.Builtin.Dictionary.Components(dictionary=valueAtKey_7)
flatten_10 = List.Flatten(list=components_6.values)
byName_4 = FamilyType.ByName(name=flatten_10)
beamByCurve = StructuralFraming.BeamByCurve(curve=byStartPointEndPoint, level=levels_3, structuralFramingType=byName_4)
code_block_32 = CodeBlock(dict_byGridName=byKeysValues) { dict_byGridName; }
valueAtKey_8 = DesignScript.Builtin.Dictionary.ValueAtKey(dictionary=byKeysValues_6, key=filterByBoolMask_2.out)
keys_3 = DesignScript.Builtin.Dictionary.Keys(dictionary=valueAtKey_8)
code_block_33 = CodeBlock { "~"; }
split_3 = String.Split(str=keys_3, separator0=code_block_33)

# group: 시점
code_block_34 = CodeBlock(i=filterByBoolMask_2.out) { i; }
firstItem_4 = List.FirstItem(list=split_3@@L2)
code_block_35 = CodeBlock(i=code_block_34, j=firstItem_4) { i +","+ j; }

flatten_11 = List.Flatten(list=code_block_35)
valueAtKey_9 = DesignScript.Builtin.Dictionary.ValueAtKey(dictionary=code_block_32, key=flatten_11)

# group: 종점
code_block_36 = CodeBlock(i=filterByBoolMask_2.out) { i; }
lastItem_2 = List.LastItem(list=split_3@@L2)
code_block_37 = CodeBlock(i=code_block_36, j=lastItem_2) { i +","+ j; }

flatten_12 = List.Flatten(list=code_block_37)
valueAtKey_10 = DesignScript.Builtin.Dictionary.ValueAtKey(dictionary=code_block_32, key=flatten_12)
byStartPointEndPoint_2 = Line.ByStartPointEndPoint(startPoint=valueAtKey_9, endPoint=valueAtKey_10, lacing=Shortest)
levels_4 = Levels("Level 1")
values = DesignScript.Builtin.Dictionary.Values(dictionary=valueAtKey_8)
flatten_13 = List.Flatten(list=values)
byName_5 = FamilyType.ByName(name=flatten_13)
beamByCurve_2 = StructuralFraming.BeamByCurve(curve=byStartPointEndPoint_2, level=levels_4, structuralFramingType=byName_5)

# group: EXCEL IMPORT
file_from_path_4 = FileObject(path=file_path)
code_block_38 = CodeBlock { "Str Columns"; }
boolean_6 = BoolSelector(false)
importExcel_4 = Data.ImportExcel(file=file_from_path_4, sheetName=code_block_38, showExcel=boolean_6)

# group: 그리드 좌표별 패밀리 타입 DICTIONARY화-for Columns
code_block_39 = CodeBlock { ","; }
code_block_40 = CodeBlock { 1; }
dropItems_7 = List.DropItems(list=importExcel_4@L2, amount=code_block_40)
code_block_41 = CodeBlock { 1; }
dropItems_8 = List.DropItems(list=dropItems_7, amount=code_block_41)
code_block_42 = CodeBlock { 0; }
getItemAtIndex_6 = List.GetItemAtIndex(list=dropItems_8@L2, index=code_block_42)
code_block_43 = CodeBlock { 1; }
dropItems_9 = List.DropItems(list=dropItems_8@L2, amount=code_block_43)
isNull_4 = Object.IsNull(object=dropItems_9)
boolean_7 = BoolSelector(false)
allIndicesOf_5 = List.AllIndicesOf(list=isNull_4@L2, item=boolean_7)
count_5 = List.Count(list=allIndicesOf_5@L2)
ofRepeatedItem_5 = List.OfRepeatedItem(item=getItemAtIndex_6, amount=count_5, lacing=Shortest)
code_block_44 = CodeBlock { 1; }
add_3 = allIndicesOf_5 + code_block_44
string_from_object_5 = FromObject(object=add_3)
list_create_5 = List.Create(item0=ofRepeatedItem_5, item1=string_from_object_5)
flatten_14 = List.Flatten(list=list_create_5@L3)
transpose_8 = List.Transpose(lists=flatten_14)
join_6 = String.Join(separator=code_block_39, string0=transpose_8)
flatten_15 = List.Flatten(list=join_6)
패밀리코드_전체_3 = CodeBlock(i=dropItems_9) { i; }
getItemAtIndex_7 = List.GetItemAtIndex(list=패밀리코드_전체_3@L2, index=allIndicesOf_5@L2)
flatten_16 = List.Flatten(list=getItemAtIndex_7)
byKeysValues_7 = DesignScript.Builtin.Dictionary.ByKeysValues(keys=flatten_15, values=flatten_16)
code_block_45 = CodeBlock(dict_byGridName=byKeysValues) { dict_byGridName; }

# group: Family Instance 배치 구간
components_7 = DesignScript.Builtin.Dictionary.Components(dictionary=byKeysValues_7)
byName_6 = FamilyType.ByName(name=components_7.values)
valueAtKey_11 = DesignScript.Builtin.Dictionary.ValueAtKey(dictionary=code_block_45, key=components_7.keys)
levels_5 = Levels("Level 1")
byPointAndLevel_3 = FamilyInstance.ByPointAndLevel(familyType=byName_6, point=valueAtKey_11, level=levels_5)

byName_7 = FamilyType.ByName(name=components_7.values)
uniqueItems_3 = List.UniqueItems(list=byName_7)
