# Dynamo graph Instance Placer_rD.dyn (Dynamo 2.10.1.3976)

# group: GRID 소환 및 X,Y 축 분류
categories = Categories("OST_Grids")
all_elements_of_category = ElementsOfCategory(Category=categories)
curve = Grid.Curve(grid=all_elements_of_category)
direction = Line.Direction(line=curve)
normalized = Vector.Normalized(vector=direction)
uniqueItems = List.UniqueItems(list=normalized)
code_block = CodeBlock(i=uniqueItems) { i[0]; }
isParallel = Vector.IsParallel(vector=code_block, other=normalized)
filterByBoolMask = List.FilterByBoolMask(list=all_elements_of_category, mask=isParallel)

# group: 교차점들 그리드 이름으로 DICTIONARY화
code_block_2 = CodeBlock { ","; }
join = String.Join(separator=code_block_2)  # unwired: string0, string1
code_block_3 = CodeBlock { "Name"; }
getParameterValueByName = Element.GetParameterValueByName(element=filterByBoolMask.in, parameterName=code_block_3)
getParameterValueByName_2 = Element.GetParameterValueByName(element=filterByBoolMask.out, parameterName=code_block_3)
cartesianProduct = List.CartesianProduct(combineFunction=join, list0=getParameterValueByName, list1=getParameterValueByName_2)
flatten = List.Flatten(list=cartesianProduct)
intersect = Geometry.Intersect(lacing=CrossProduct)  # unwired: geometry, other
curve_2 = Grid.Curve(grid=filterByBoolMask.in)
curve_3 = Grid.Curve(grid=filterByBoolMask.out)
cartesianProduct_2 = List.CartesianProduct(combineFunction=intersect, list0=curve_2, list1=curve_3)
flatten_2 = List.Flatten(list=cartesianProduct_2@L3)
flatten_3 = List.Flatten(list=flatten_2)
byKeysValues = DesignScript.Builtin.Dictionary.ByKeysValues(keys=flatten, values=flatten_3)

# group: ExcelPath
file_path = Filename(".\3_Structural Member Auto Creation_Sample_revised.xlsx")

input_통합_구간 = CodeBlock(crossPointDic=byKeysValues, excelPath=file_path)
# ---------- input_통합_구간.designscript (4 lines) ----------
{
"crossPointDic": crossPointDic,
"excelPath": excelPath
};
# ----------------------------------------

# group: EXCEL IMPORT
input_manager = CodeBlock(i=input_통합_구간) { i["crossPointDic"]; i["excelPath"]; }
file_from_path = FileObject(path=input_manager.out1)
code_block_4 = CodeBlock { "Str Foundations"; }
python_script_import_excel_by = Python(IN[0]=file_from_path, IN[1]=code_block_4)  # "Python Script@Import Excel(By OpenpyXl)_rB"; CPython3
# ---------- python_script_import_excel_by.python (90 lines) ----------
# Load the Python Standard and DesignScript Libraries
import os
python_rootpath = os.getenv('LOCALAPPDATA')+'\Programs\Python'
file_list = os.listdir(python_rootpath)
python_version = file_list[0]
import sys
sys.path.append(os.getenv('LOCALAPPDATA').replace('\\','\\\\') + f'\Programs\Python\{python_version}\Lib\site-packages')
import clr
clr.AddReference('RevitAPI')
import Autodesk

clr.AddReference('ProtoGeometry')
from Autodesk.DesignScript.Geometry import *

clr.AddReference('RevitNodes')
import Revit
clr.ImportExtensions(Revit.Elements)

clr.ImportExtensions(Revit.GeometryConversion)
clr.ImportExtensions(Revit.GeometryReferences)

clr.AddReference('RevitServices')
import RevitServices
from RevitServices.Persistence import DocumentManager
from RevitServices.Transactions import TransactionManager

doc = DocumentManager.Instance.CurrentDBDocument

import random
import itertools
from functools import reduce
from collections import Iterable
import datetime
import openpyxl

# The inputs to this node will be stored as a list in the IN variables.
dataEnteringNode = IN
inputFilePath = IN[0]
inputSheetName = IN[1]

def importExcel(path, SheetNameIn):
    wb_obj = openpyxl.load_workbook(str(path), data_only=True)
    sheet_obj = wb_obj.get_sheet_by_name(str(SheetNameIn))

    m_row = sheet_obj.max_row
    m_col = sheet_obj.max_column

    listOut = []

    for i in range(1, m_row +1):
        listTemp = []
        for j in range(1, m_col + 1):
            cell_obj = sheet_obj.cell(row=i, column=j)
            listTemp.append(cell_obj.value)
            if len(listTemp) == m_col:
                listOut.append(listTemp)
    return listOut

def checkAllElement(list, target):
    tmp=[]
    for i in list:
        if i == target:
            tmp.append(True)
        else:
            tmp.append(False)
    return all(tmp)


# Place your code below this line

result = importExcel(inputFilePath, inputSheetName)

for i in result:## null만 있는 Excel Row 제거
    if checkAllElement(i, None):
        result.remove(i)
    else:
        pass
        
result_tr = list(zip(*result))

for i in result_tr:## null만 있는 Excel Row 제거
    if checkAllElement(i, None):
        result_tr.remove(i)
    else:
        pass

result = list(zip(*result_tr))

# Assign your output to the OUT variable.
OUT = result
# ----------------------------------------
output_manager = CodeBlock(crossPointDic=input_manager.out0, excelData=python_script_import_excel_by)
# ---------- output_manager.designscript (4 lines) ----------
{
"crossPointDic": crossPointDic,
"excelData":excelData
};
# ----------------------------------------

# group: 그리드 좌표별 패밀리 타입 DICTIONARY화-for FDN
input_manager_2 = CodeBlock(i=output_manager) { i["crossPointDic"]; i["excelData"]; }
python_script_2중_dictionary_형성 = Python(IN[0]=input_manager_2.out1)  # "Python Script@2중 dictionary 형성(null 제거 및 x,y 형태로 반환)"; CPython3
# ---------- python_script_2중_dictionary_형성.python (53 lines) ----------
# Load the Python Standard and DesignScript Libraries
import sys
import clr
clr.AddReference('ProtoGeometry')
from Autodesk.DesignScript.Geometry import *

# The inputs to this node will be stored as a list in the IN variables.
dataEnteringNode = IN

inputWholeData = IN[0]

# Place your code below this line


header_H = inputWholeData.pop(0)
dict_H = {}
for i in range(len(inputWholeData)):
    dict_V = {}
    for j in range(len(inputWholeData[i])):
        if j > 0:
            dict_V[str(header_H[j]).split('.')[0]] = inputWholeData[i][j]
        else:
            pass
    dict_H[inputWholeData[i][0]] = dict_V


try:
    for value in dict_H.values():
        value.pop("None")
except:
    pass

dict_H_eff = {}
for i in dict_H.keys():
    dict_tmp = {}
    for j in dict_H[i].keys(): # j == '1','2','3','4',...
        if str(dict_H[i][j]) != "None": #dict 값이 null 인 key값 제거
            dict_tmp[j] = dict_H[i][j]
        else:
            pass
    dict_H_eff[i] = dict_tmp

dict_commaFormat = {}
for i in dict_H_eff.keys():
    for j in dict_H_eff[i].keys():
        dict_commaFormat[f'{i},{j}'] = dict_H_eff[i][j]




result = dict_commaFormat
# Assign your output to the OUT variable.
OUT = result
# ----------------------------------------
output_manager_2 = CodeBlock(crossPointDic=input_manager_2.out0, crossFamilyTypeDic=python_script_2중_dictionary_형성)
# ---------- output_manager_2.designscript (4 lines) ----------
{
"crossPointDic": crossPointDic,
"crossFamilyTypeDic":crossFamilyTypeDic
};
# ----------------------------------------

# group: Family Instance 배치 구간
input_manager_3 = CodeBlock(i=output_manager_2) { i["crossPointDic"]; i["crossFamilyTypeDic"]; }
components = DesignScript.Builtin.Dictionary.Components(dictionary=input_manager_3.out1)
byName = FamilyType.ByName(name=components.values)
valueAtKey = DesignScript.Builtin.Dictionary.ValueAtKey(dictionary=input_manager_3.out0, key=components.keys)
levels = Levels("Level 3")
byPointAndLevel = FamilyInstance.ByPointAndLevel(familyType=byName, point=valueAtKey, level=levels)
reference_output_manager = CodeBlock(ref_crossFamilyTypeDic=input_manager_3.out1) { ref_crossFamilyTypeDic; }

# group: EXCEL IMPORT
input_manager_4 = CodeBlock(i=input_통합_구간) { i["crossPointDic"]; i["excelPath"]; }
file_from_path_2 = FileObject(path=input_manager_4.out1)
code_block_5 = CodeBlock { "Str Pedestal"; }
python_script_import_excel_by_2 = Python(IN[0]=file_from_path_2, IN[1]=code_block_5)  # "Python Script@Import Excel(By OpenpyXl)_rB"; CPython3; same code as python_script_import_excel_by
output_manager_3 = CodeBlock(crossPointDic=input_manager_4.out0, excelData=python_script_import_excel_by_2)  # same code as output_manager

# group: 그리드 좌표별 패밀리 타입 DICTIONARY화-for Pedestal
input_manager_5 = CodeBlock(i=output_manager_3) { i["crossPointDic"]; i["excelData"]; }
python_script_2중_dictionary_형성_2 = Python(IN[0]=input_manager_5.out1)  # "Python Script@2중 dictionary 형성(null 제거 및 x,y 형태로 반환)"; CPython3; same code as python_script_2중_dictionary_형성
output_manager_4 = CodeBlock(crossPointDic=input_manager_5.out0, crossFamilyTypeDic=python_script_2중_dictionary_형성_2)  # same code as output_manager_2

# group: Family Instance 배치 구간
input_manager_6 = CodeBlock(ref_crossFamilyTypeDic=reference_output_manager, i=output_manager_4) { ref_crossFamilyTypeDic; i["crossPointDic"]; i["crossFamilyTypeDic"]; }
components_2 = DesignScript.Builtin.Dictionary.Components(dictionary=input_manager_6.out2)
byName_2 = FamilyType.ByName(name=components_2.values)
valueAtKey_2 = DesignScript.Builtin.Dictionary.ValueAtKey(dictionary=input_manager_6.out1, key=components_2.keys)
levels_2 = Levels("Level 3")
byPointAndLevel_2 = FamilyInstance.ByPointAndLevel(familyType=byName_2, point=valueAtKey_2, level=levels_2)
byKeysValues_2 = DesignScript.Builtin.Dictionary.ByKeysValues(keys=components_2.keys, values=byPointAndLevel_2)
components_3 = DesignScript.Builtin.Dictionary.Components(dictionary=input_manager_6.ref_crossFamilyTypeDic)
valueAtKey_3 = DesignScript.Builtin.Dictionary.ValueAtKey(dictionary=byKeysValues_2, key=components_3.keys)
code_block_6 = CodeBlock { "Base Offset"; }
byName_3 = FamilyType.ByName(name=components_3.values)
code_block_7 = CodeBlock { "Foundation Thickness"; }
getParameterValueByName_3 = Element.GetParameterValueByName(element=byName_3, parameterName=code_block_7)
setParameterByName = Element.SetParameterByName(element=valueAtKey_3, parameterName=code_block_6, value=getParameterValueByName_3)

# group: EXCEL IMPORT
input_manager_7 = CodeBlock(i=input_통합_구간) { i["crossPointDic"]; i["excelPath"]; }
file_from_path_3 = FileObject(path=input_manager_7.out1)
code_block_8 = CodeBlock { "Str TG"; }
python_script_import_excel_by_3 = Python(IN[0]=file_from_path_3, IN[1]=code_block_8)  # "Python Script@Import Excel(By OpenpyXl)_rB"; CPython3; same code as python_script_import_excel_by
output_manager_5 = CodeBlock(crossPointDic=input_manager_7.out0, excelData=python_script_import_excel_by_3)  # same code as output_manager

# group: 그리드 좌표별 패밀리 타입 DICTIONARY화-for T/G
input_manager_8 = CodeBlock(i=output_manager_5) { i["crossPointDic"]; i["excelData"]; }
python_script_2중_dictionary_형성_3 = Python(IN[0]=input_manager_8.out1)  # "Python Script@2중 dictionary 형성(null 제거 및 x,y 형태로 반환)"; CPython3; same code as python_script_2중_dictionary_형성
components_4 = DesignScript.Builtin.Dictionary.Components(dictionary=python_script_2중_dictionary_형성_3)
시점_종점_형태_dictionary_형성 = Python(IN[0]=python_script_2중_dictionary_형성_3)  # CPython3
# ---------- 시점_종점_형태_dictionary_형성.python (30 lines) ----------
# Load the Python Standard and DesignScript Libraries
import sys
import clr
clr.AddReference('ProtoGeometry')
from Autodesk.DesignScript.Geometry import *

# The inputs to this node will be stored as a list in the IN variables.
dataEnteringNode = IN

inputDic = IN[0]
# Place your code below this line
resultDic = {}
for i in inputDic.keys():
    betweenGrid = i.split(',')
    for j in betweenGrid:
        if "~" in j:
            _start = j.split('~')[0]
            _end = j.split('~')[1]
        else:
            _refGrid = j
            
    if _refGrid.isalpha():
        resultDic[i] = f'{_refGrid},{_start}',f'{_refGrid},{_end}'
    else:
        resultDic[i] = f'{_start},{_refGrid}',f'{_end},{_refGrid}'


result = resultDic
# Assign your output to the OUT variable.
OUT = result
# ----------------------------------------
valueAtKey_4 = DesignScript.Builtin.Dictionary.ValueAtKey(dictionary=시점_종점_형태_dictionary_형성, key=components_4.keys)
valueAtKey_5 = DesignScript.Builtin.Dictionary.ValueAtKey(dictionary=input_manager_8.out0, key=valueAtKey_4)
firstItem = List.FirstItem(list=valueAtKey_5@L2)
lastItem = List.LastItem(list=valueAtKey_5@L2)
byStartPointEndPoint = Line.ByStartPointEndPoint(startPoint=firstItem, endPoint=lastItem)
byKeysValues_3 = DesignScript.Builtin.Dictionary.ByKeysValues(keys=components_4.keys, values=byStartPointEndPoint)
output_manager_6 = CodeBlock(crossPointDic=input_manager_8.out0, crossFamilyTypeDic=python_script_2중_dictionary_형성_3, startEndLineDic=byKeysValues_3)
# ---------- output_manager_6.designscript (5 lines) ----------
{
"crossPointDic": crossPointDic,
"crossFamilyTypeDic":crossFamilyTypeDic,
"startEndLineDic": startEndLineDic
};
# ----------------------------------------

# group: Family Instance 배치 구간
input_manager_9 = CodeBlock(i=output_manager_6) { i["crossPointDic"]; i["crossFamilyTypeDic"]; i["startEndLineDic"]; }
components_5 = DesignScript.Builtin.Dictionary.Components(dictionary=input_manager_9.out1)
valueAtKey_6 = DesignScript.Builtin.Dictionary.ValueAtKey(dictionary=input_manager_9.out2, key=components_5.keys)
levels_3 = Levels("Level 1")
elevation = Level.Elevation(level=levels_3)
translate = Geometry.Translate(geometry=valueAtKey_6, zTranslation=elevation)
byName_4 = FamilyType.ByName(name=components_5.values)
beamByCurve = StructuralFraming.BeamByCurve(curve=translate, level=levels_3, structuralFramingType=byName_4)

# group: EXCEL IMPORT
input_manager_10 = CodeBlock(i=input_통합_구간) { i["crossPointDic"]; i["excelPath"]; }
file_from_path_4 = FileObject(path=input_manager_10.out1)
code_block_9 = CodeBlock { "Str Columns"; }
python_script_import_excel_by_4 = Python(IN[0]=file_from_path_4, IN[1]=code_block_9)  # "Python Script@Import Excel(By OpenpyXl)_rB"; CPython3; same code as python_script_import_excel_by
output_manager_7 = CodeBlock(crossPointDic=input_manager_10.out0, excelData=python_script_import_excel_by_4)  # same code as output_manager

# group: 그리드 좌표별 패밀리 타입 DICTIONARY화-for Pedestal
input_manager_11 = CodeBlock(i=output_manager_7) { i["crossPointDic"]; i["excelData"]; }
python_script_2중_dictionary_형성_4 = Python(IN[0]=input_manager_11.out1)  # "Python Script@2중 dictionary 형성(null 제거 및 x,y 형태로 반환)"; CPython3; same code as python_script_2중_dictionary_형성
output_manager_8 = CodeBlock(crossPointDic=input_manager_11.out0, crossFamilyTypeDic=python_script_2중_dictionary_형성_4)  # same code as output_manager_2

# group: Family Instance 배치 구간
input_manager_12 = CodeBlock(i=output_manager_8) { i["crossPointDic"]; i["crossFamilyTypeDic"]; }
components_6 = DesignScript.Builtin.Dictionary.Components(dictionary=input_manager_12.out1)
byName_5 = FamilyType.ByName(name=components_6.values)
valueAtKey_7 = DesignScript.Builtin.Dictionary.ValueAtKey(dictionary=input_manager_12.out0, key=components_6.keys)
levels_4 = Levels("Level 1")
byPointAndLevel_3 = FamilyInstance.ByPointAndLevel(familyType=byName_5, point=valueAtKey_7, level=levels_4)
components_7 = DesignScript.Builtin.Dictionary.Components(dictionary=input_manager_12.out1)

# group: EXCEL IMPORT
input_manager_13 = CodeBlock(i=input_통합_구간) { i["crossPointDic"]; i["excelPath"]; }
file_from_path_5 = FileObject(path=input_manager_13.out1)
code_block_10 = CodeBlock { "Str Framing"; }
python_script_import_excel_by_5 = Python(IN[0]=file_from_path_5, IN[1]=code_block_10)  # "Python Script@Import Excel(By OpenpyXl)_rB"; CPython3; same code as python_script_import_excel_by
output_manager_9 = CodeBlock(crossPointDic=input_manager_13.out0, excelData=python_script_import_excel_by_5)  # same code as output_manager

# group: 그리드 좌표별 패밀리 타입 DICTIONARY화-for Framing
input_manager_14 = CodeBlock(i=output_manager_9) { i["crossPointDic"]; i["excelData"]; }
python_script_2중_dictionary_형성_5 = Python(IN[0]=input_manager_14.out1)  # "Python Script@2중 dictionary 형성(null 제거 및 x,y 형태로 반환)"; CPython3; same code as python_script_2중_dictionary_형성
components_8 = DesignScript.Builtin.Dictionary.Components(dictionary=python_script_2중_dictionary_형성_5)
시점_종점_형태_dictionary_형성_2 = Python(IN[0]=python_script_2중_dictionary_형성_5)  # CPython3; same code as 시점_종점_형태_dictionary_형성
valueAtKey_8 = DesignScript.Builtin.Dictionary.ValueAtKey(dictionary=시점_종점_형태_dictionary_형성_2, key=components_8.keys)
valueAtKey_9 = DesignScript.Builtin.Dictionary.ValueAtKey(dictionary=input_manager_14.out0, key=valueAtKey_8)
firstItem_2 = List.FirstItem(list=valueAtKey_9@L2)
lastItem_2 = List.LastItem(list=valueAtKey_9@L2)
byStartPointEndPoint_2 = Line.ByStartPointEndPoint(startPoint=firstItem_2, endPoint=lastItem_2)
byKeysValues_4 = DesignScript.Builtin.Dictionary.ByKeysValues(keys=components_8.keys, values=byStartPointEndPoint_2)
output_manager_10 = CodeBlock(crossPointDic=input_manager_14.out0, crossFamilyTypeDic=python_script_2중_dictionary_형성_5, startEndLineDic=byKeysValues_4)  # same code as output_manager_6

# group: Family Instance 배치 구간
input_manager_15 = CodeBlock(i=output_manager_10) { i["crossPointDic"]; i["crossFamilyTypeDic"]; i["startEndLineDic"]; }
components_9 = DesignScript.Builtin.Dictionary.Components(dictionary=input_manager_15.out1)
valueAtKey_10 = DesignScript.Builtin.Dictionary.ValueAtKey(dictionary=input_manager_15.out2, key=components_9.keys)
levels_5 = Levels("Level 2")
elevation_2 = Level.Elevation(level=levels_5)
translate_2 = Geometry.Translate(geometry=valueAtKey_10, zTranslation=elevation_2)
byName_6 = FamilyType.ByName(name=components_9.values)
beamByCurve_2 = StructuralFraming.BeamByCurve(curve=translate_2, level=levels_5, structuralFramingType=byName_6)
