# Dynamo graph 20211201_webrequest test.dyn (Dynamo 2.10.1.3976)

string = StringInput("https://raw.githubusercontent.com/HNANmal/mQ/master/Laboratory/20211123_%EC%9E%85%EC%B0%B0%EC%9E%90%EB%8F%99%ED%99%94%ED%88%B4Test%20Sample/test.py")
web_request = WebRequest(url=string)
python_script = Python()  # CPython3; frozen; unwired: IN[0]
# ---------- python_script.python (27 lines) ----------
# Load the Python Standard and DesignScript Libraries
import sys
import clr
clr.AddReference('ProtoGeometry')
from Autodesk.DesignScript.Geometry import *

# The inputs to this node will be stored as a list in the IN variables.
dataEnteringNode = IN

inputString = IN[0]

# Place your code below this line

# Python program to illustrate use of exec to
# execute a given code as string.
 
# function illustrating how exec() functions.
def exec_code(inputString):
    LOC = f'{inputString}'

    exec(LOC)
     
# Driver Code
result = exec_code(inputString)

# Assign your output to the OUT variable.
OUT = result
# ----------------------------------------
string_from_web = Python()  # CPython3; unwired: IN[0]
# ---------- string_from_web.python (19 lines) ----------
# Load the Python Standard and DesignScript Libraries
import sys
import clr
clr.AddReference('ProtoGeometry')
from Autodesk.DesignScript.Geometry import *
import urllib.request

# The inputs to this node will be stored as a list in the IN variables.
dataEnteringNode = IN
inputURL = "https://raw.githubusercontent.com/HNANmal/mQ/master/Laboratory/20211123_%EC%9E%85%EC%B0%B0%EC%9E%90%EB%8F%99%ED%99%94%ED%88%B4Test%20Sample/test.py"

# Place your code below this line
req = urllib.request
data = req.urlopen(inputURL)

result = data.read().decode("utf-8")

# Assign your output to the OUT variable.
OUT = result
# ----------------------------------------
file_path = Filename("D:\mk\mQ\Laboratory\20211123_입찰자동화툴Test Sample\01_Building List_Pilot Project_2021_1124.xlsx")
code_block = CodeBlock { "Building List"; }
python_script_from_string = PythonStringNode(script=string_from_web, IN[0]=file_path, IN[1]=code_block)  # IronPython2
