# Dynamo graph FamilyParameter_Using_sample(1216).dyn "fdn_explode_sample(1216)" (Dynamo 2.10.1.3976)

# group: 1. All Element of FDNs
categories = Categories("OST_StructuralFoundation")
all_elements_of_category = ElementsOfCategory(Category=categories)

# group: 2. 형상 추출 및 Model Text 형상 제외
geometry = Element.Geometry(element=all_elements_of_category)
explode = Geometry.Explode(geometry=geometry)
count = List.Count(list=explode@@L2)
code_block = CodeBlock(i=count) { i==6; }
filterByBoolMask = List.FilterByBoolMask(list=geometry, mask=code_block)
flatten = List.Flatten(list=filterByBoolMask.in)

# group: 3. 측면 surface 필터링
explode_2 = Geometry.Explode(geometry=flatten)
code_block_2 = CodeBlock { 0.5; }
normalAtParameter = Surface.NormalAtParameter(surface=explode_2, u=code_block_2, v=code_block_2)
Z = Vector.Z(vector=normalAtParameter)
code_block_3 = CodeBlock(i=Z) { i==0; }
filterByBoolMask_2 = List.FilterByBoolMask(list=explode_2, mask=code_block_3)

code_block_4 = CodeBlock(i=filterByBoolMask_2.in) { i; }

# group: 4. 기초별 측면 면적 합 계산
area = Surface.Area(surface=code_block_4)
sum = Math.Sum(values=area)
code_block_5 = CodeBlock(result=sum) { result/1000000; }

# group: 5. 계산 값 문자열 변환
code_block_6 = CodeBlock { 2; }
round = Math.Round(number=code_block_5, digits=code_block_6)
code_block_7 = CodeBlock(i=round) { i +" m2"; }

# group: 6. 기초 별 측면 면적 값을 기초 패밀리 내부 모델텍스트로 입력
code_block_8 = CodeBlock { "ModelText"; }
setParameterByName = Element.SetParameterByName(element=all_elements_of_category, parameterName=code_block_8, value=code_block_7)

# group: 8. Select ModelText Element
categories_2 = Categories("OST_GenericModel")
all_elements_of_category_2 = ElementsOfCategory(Category=categories_2)
string_from_object = FromObject(object=all_elements_of_category_2)
code_block_9 = CodeBlock(i=string_from_object) { i=="ModelText"; }
filterByBoolMask_3 = List.FilterByBoolMask(list=all_elements_of_category_2, mask=code_block_9)
firstItem = List.FirstItem(list=filterByBoolMask_3.in)

# group: 7. 기초 측면 총합 계산 및 문자열 변환
sum_2 = Math.Sum(values=code_block_5)
code_block_10 = CodeBlock(i=sum_2) { "Total FDN SideFace Area\n\n"+"= " + i + " m2"; }

# group: 9. 총합 면적 모델 텍스트에 입력
code_block_11 = CodeBlock { "Text"; }
setParameterByName_2 = Element.SetParameterByName(element=firstItem, parameterName=code_block_11, value=code_block_10)
