# Dynamo graph fdn_explode_sample(1216).dyn (Dynamo 2.10.1.3976)

# group: 1. All Element of FDNs
categories = Categories("OST_StructuralFoundation")
all_elements_of_category = ElementsOfCategory(Category=categories)

select_model_element = DSModelElementSelection()  # 1 picked in the model

# group: 2. 형상 추출
geometry = Element.Geometry(element=select_model_element)
flatten = List.Flatten(list=geometry)

code_block = CodeBlock { "abc"; }
firstItem = List.FirstItem(list=geometry)

# group: 3. 측면 surface 필터링
explode = Geometry.Explode(geometry=firstItem)
code_block_2 = CodeBlock { 0.5; }
normalAtParameter = Surface.NormalAtParameter(surface=explode, u=code_block_2, v=code_block_2)
Z = Vector.Z(vector=normalAtParameter)
code_block_3 = CodeBlock(i=Z) { i==0; }
filterByBoolMask = List.FilterByBoolMask(list=explode, mask=code_block_3)

# group: 3. 측면 surface 필터링
explode_2 = Geometry.Explode(geometry=firstItem)
code_block_4 = CodeBlock { 0.5; }
normalAtParameter_2 = Surface.NormalAtParameter(surface=explode_2, u=code_block_4, v=code_block_4)
Z_2 = Vector.Z(vector=normalAtParameter_2)
code_block_5 = CodeBlock(i=Z_2) { i==-1; }
filterByBoolMask_2 = List.FilterByBoolMask(list=explode_2, mask=code_block_5)

perimeterCurves = Surface.PerimeterCurves(surface=filterByBoolMask_2.in)
flatten_2 = List.Flatten(list=perimeterCurves)
code_block_6 = CodeBlock { 0.1; }
trimByStartParameter = Curve.TrimByStartParameter(curve=flatten_2, startParameter=code_block_6)
code_block_7 = CodeBlock { 0.9; }
trimByEndParameter = Curve.TrimByEndParameter(curve=trimByStartParameter, endParameter=code_block_7)
doesIntersect = Geometry.DoesIntersect(geometry=trimByEndParameter, other=filterByBoolMask.in, lacing=CrossProduct)
code_block_8 = CodeBlock { true; }
allIndicesOf = List.AllIndicesOf(list=doesIntersect@L2, item=code_block_8)
getItemAtIndex = List.GetItemAtIndex(list=filterByBoolMask.in, index=allIndicesOf)

# group: 4. 각 측면 별 중점 및 법선 벡터 추출
code_block_9 = CodeBlock(input=getItemAtIndex) { input; }
code_block_10 = CodeBlock { 0.5; }
pointAtParameter = Surface.PointAtParameter(surface=code_block_9, u=code_block_10, v=code_block_10)
normalAtParameter_3 = Surface.NormalAtParameter(surface=code_block_9, u=code_block_10, v=code_block_10)

direction = Line.Direction(line=flatten_2)
byOriginNormalXAxis = Plane.ByOriginNormalXAxis(origin=pointAtParameter, normal=normalAtParameter_3, xAxis=direction, lacing=Shortest)

# group: 5. 각 측면 별 작업 평면 생성
byPlane = SketchPlane.ByPlane(plane=byOriginNormalXAxis)
XAxis = Vector.XAxis()

flatten_3 = List.Flatten(list=byPlane)
code_block_11 = CodeBlock { 0; }
code_block_12 = CodeBlock { 0.5; }
code_block_13 = CodeBlock { "Model Text 1"; }
byName = ModelTextType.ByName(name=code_block_13)
byTextSketchPlaneAndPosition = ModelText.ByTextSketchPlaneAndPosition(text=code_block, sketchPlane=flatten_3, xCoordinateInPlane=code_block_11, yCoordinateInPlane=code_block_11, textDepth=code_block_12, modelTextType=byName)
if_ = If()  # unwired: test, true, false
normal = Plane.Normal()  # unwired: plane
perimeterCurves_2 = Surface.PerimeterCurves()  # unwired: surface
direction_2 = Line.Direction(line=perimeterCurves_2)
Z_3 = Vector.Z(vector=direction_2)
code_block_14 = CodeBlock(i=Z_3) { i==0; }
filterByBoolMask_3 = List.FilterByBoolMask(list=perimeterCurves_2, mask=code_block_14)
startPoint = Curve.StartPoint(curve=filterByBoolMask_3.in)
Z_4 = Point.Z(point=startPoint)
flatten_4 = List.Flatten(list=Z_4)
uniqueItems = List.UniqueItems(list=flatten_4)
minimumItem = List.MinimumItem(list=uniqueItems)
eq = Z_4 == minimumItem
filterByBoolMask_4 = List.FilterByBoolMask(list=filterByBoolMask_3.in, mask=eq)
direction_3 = Line.Direction(line=filterByBoolMask_4.in)
flatten_5 = List.Flatten(list=direction_3)
byOriginXAxisYAxis = Plane.ByOriginXAxisYAxis()
