# Dynamo graph midas_mxt_parsing.dyn (Dynamo 2.12.0.5650)

beamByCurve = StructuralFraming.BeamByCurve()  # unwired: curve, level, structuralFramingType
columnByCurve = StructuralFraming.ColumnByCurve()  # unwired: curve, level, structuralColumnType
file_path = Filename(".\Ulsan_CEB & Admin. Building_New2(Size)_BOQ.xlsx")
string = StringInput("Ulsan_CEB & Admin. Building_New")
initial_data_import = Python(IN[0]=file_path, IN[1]=string)  # CPython3
# ---------- initial_data_import.python (95 lines) ----------
# Load the Python Standard and DesignScript Libraries
import os
import sys
import re
import clr

python_rootpath = os.getenv('LOCALAPPDATA')+'\Programs\Python'
python_dir_list = os.listdir(python_rootpath)

p = re.compile('Python\d{2,5}')
version_list = list(filter(lambda x: p.match(x), python_dir_list))
version_num = list(map(lambda x: int(x[7:]), version_list))
latest_idx= version_num.index(max(version_num))

python_version = version_list[latest_idx]

sys.path.append(os.getenv('LOCALAPPDATA').replace('\\','\\\\') + f'\Programs\Python\{python_version}\Lib\site-packages')

clr.AddReference('ProtoGeometry')
from Autodesk.DesignScript.Geometry import *

from collections import Iterable
import datetime
import openpyxl

from itertools import chain
from functools import reduce

curry = lambda f: lambda a,*args: f(a, *args) if (len(args)) else lambda *args: f(a, *args)

add = curry(lambda a,b: a + b)

filter = curry(filter)
map = curry(map)

def _take(length, iter):
    res = []
    for a in iter:
        res.append(a)
        if len(res) == length:
            return res
take = curry(_take)
reduce = curry(reduce)
go = lambda *args: reduce(lambda a,f: f(a), args)

# The inputs to this node will be stored as a list in the IN variables.
dataEnteringNode = IN
inputFilePath = IN[0]
inputSheetName = IN[1]

# Place your code below this line

def importExcel(path, SheetNameIn):
    wb_obj = openpyxl.load_workbook(str(path), data_only=True)
    sheet_obj = wb_obj.get_sheet_by_name(str(SheetNameIn))

    m_row = sheet_obj.max_row
    m_col = sheet_obj.max_column

    listOut = []

    for i in range(1, m_row +1):
        listTemp = []
        for j in range(1, m_col + 1):
            cell_obj = sheet_obj.cell(row=i, column=j)
            listTemp.append(cell_obj.value)
            if len(listTemp) == m_col:
                listOut.append(listTemp)
    return listOut

def checkAllElement(list, target):
    tmp=[]
    for i in list:
        if i == target:
            tmp.append(True)
        else:
            tmp.append(False)
    return all(tmp)

rm_Null = lambda list: go(list,
    filter(lambda a: not checkAllElement(a, None)),
    )

s1 = importExcel(inputFilePath, inputSheetName)

s2 = rm_Null(s1)  ## null만 있는 Excel Row 제거

result_tr = list(zip(*s2))

s3 = rm_Null(result_tr) ## null만 있는 Excel Column 제거

result = list(zip(*s3))

# Assign your output to the OUT variable.
OUT = result
# ----------------------------------------
code_block = CodeBlock { "*"; }
find_identifier_row_idx = Python(IN[0]=initial_data_import, IN[1]=code_block)  # CPython3
# ---------- find_identifier_row_idx.python (37 lines) ----------
# Load the Python Standard and DesignScript Libraries
import sys
import clr
clr.AddReference('ProtoGeometry')
from Autodesk.DesignScript.Geometry import *
from functools import reduce

# The inputs to this node will be stored as a list in the IN variables.
dataEnteringNode = IN

input = IN[0]
idf = IN[1]
# Place your code below this line

def find_tgrow_idx(tglst, idf, mode):
    if mode == "sttwith":
        def chck_identifier(x, idf):
            eres = str(x).startswith("['" + idf)
            return eres
            
    elif mode == "incld":
        def chck_identifier(x, idf):
            eres = str(x).find(idf)
            if eres >= 0:
                return True
            else:
                return False
        
    
    bln_res = list(map(lambda x: chck_identifier(x,idf), tglst))
    result = [i for i, x in enumerate(bln_res) if x]
    return result


result = find_tgrow_idx(input, idf, "sttwith")
# Assign your output to the OUT variable.
OUT = result
# ----------------------------------------
code_block_2 = CodeBlock { -1; }
dropItems = List.DropItems(list=find_identifier_row_idx, amount=code_block_2)
code_block_3 = CodeBlock { 0; }
splitdataasdict_불필요null_제거 = Python(IN[0]=initial_data_import, IN[1]=dropItems, IN[2]=code_block_3)  # CPython3
# ---------- splitdataasdict_불필요null_제거.python (72 lines) ----------
# Load the Python Standard and DesignScript Libraries
import sys
import clr
clr.AddReference('ProtoGeometry')
from Autodesk.DesignScript.Geometry import *
from functools import reduce

curry = lambda f: lambda a,*args: f(a, *args) if (len(args)) else lambda *args: f(a, *args)

add = curry(lambda a,b: a + b)

filter = curry(filter)
map = curry(map)

def _take(length, iter):
    res = []
    for a in iter:
        res.append(a)
        if len(res) == length:
            return res
take = curry(_take)
reduce = curry(reduce)
go = lambda *args: reduce(lambda a,f: f(a), args)

def checkAllElement(list, target):
    tmp=[]
    for i in list:
        if i == target:
            tmp.append(True)
        else:
            tmp.append(False)
    return all(tmp)

rm_Null = lambda list: go(list,
    filter(lambda a: not checkAllElement(a, None)),
    )

# The inputs to this node will be stored as a list in the IN variables.
dataEnteringNode = IN

input = IN[0]
split_idx = IN[1]
key_idx = IN[2]

# Place your code below this line
def splitDataAsDict(split_idx, data, key_idx):

    def calc_range(split_idx):
        res = []
        for i,x in enumerate(split_idx):
            if i < len(split_idx)-1:
                res.append((x, split_idx[i+1]))
            else:
                res.append((x, len(input)))
        return res
    
    range = calc_range(split_idx)

    result = []
    dic = {}
    for x in range:
        key = str(data[x[0]][key_idx]).split('    ;')[0]
        val1 = data[x[0]+1:x[1]]
        val_tr = list(zip(*val1))
        val = list(zip(*rm_Null(val_tr)))
        dic[str(key)] = val
    return dic

result = splitDataAsDict(split_idx, input, key_idx)

# Assign your output to the OUT variable.
OUT = result
# ----------------------------------------
keys = DesignScript.Builtin.Dictionary.Keys(dictionary=splitdataasdict_불필요null_제거)

# group: NODE inform select
code_block_4 = CodeBlock(i=keys) { i[5]; }
code_block_5 = CodeBlock(i=splitdataasdict_불필요null_제거, j=code_block_4) { i[j]; }

removeHeadFromDict = Python(IN[0]=code_block_5)  # CPython3
# ---------- removeHeadFromDict.python (39 lines) ----------
# Load the Python Standard and DesignScript Libraries
import sys
import clr
clr.AddReference('ProtoGeometry')
from Autodesk.DesignScript.Geometry import *
from functools import reduce

# The inputs to this node will be stored as a list in the IN variables.
dataEnteringNode = IN

input = IN[0]

# Place your code below this line

def find_tgrow_idx(tglst, idf):

    def chck_identifier(tglst, idf):
        eres = list(map(lambda x: str(x).find(idf), tglst)) 
        res = reduce(lambda a,b: a*b, eres)
        if res == 0:
            return True
    
    bln_res = list(map(lambda x: chck_identifier(x,idf), tglst))
    result = [i for i, x in enumerate(bln_res) if x == True]
    return result

def removeHeadFromDict(tglst, idf):
    result = []
    del_idx = find_tgrow_idx(tglst,idf)
    for i,x in enumerate(tglst):
        if i in del_idx:
            pass
        else:
            result.append(x)
    return result

result = removeHeadFromDict(input,';')
# Assign your output to the OUT variable.
OUT = result
# ----------------------------------------
원점정하고_좌표계변환_단위_m_mm = Python(IN[0]=removeHeadFromDict)  # CPython3
# ---------- 원점정하고_좌표계변환_단위_m_mm.python (34 lines) ----------
# Load the Python Standard and DesignScript Libraries
import sys
import clr
clr.AddReference('ProtoGeometry')
from Autodesk.DesignScript.Geometry import *

# The inputs to this node will be stored as a list in the IN variables.
dataEnteringNode = IN
input = IN[0]

# Place your code below this line
def findOrigin(pts):
    origin = pts[0]
    
    ori_ptX = origin[1]
    ori_ptY = origin[2]
    ori_pyZ = origin[3]
    origin = (ori_ptX, ori_ptY, ori_pyZ)
    
    return origin

def trnslt_pt(pts, origin):
    def set_trPt(pt):
        res = (pt[0], pt[1]-origin[0], pt[2]-origin[1], pt[3]-origin[2])
        return res
        
    result = list(map(lambda x: set_trPt(x), pts))
    return result

origin = findOrigin(input)
result = trnslt_pt(input, origin)

# Assign your output to the OUT variable.
OUT = result
# ----------------------------------------
다이나모_포인트로_변환_및_딕셔너리화 = Python(IN[0]=원점정하고_좌표계변환_단위_m_mm)  # CPython3
# ---------- 다이나모_포인트로_변환_및_딕셔너리화.python (26 lines) ----------
# Load the Python Standard and DesignScript Libraries
import sys
import clr
clr.AddReference('ProtoGeometry')
from Autodesk.DesignScript.Geometry import *

# The inputs to this node will be stored as a list in the IN variables.
dataEnteringNode = IN
input = IN[0]
# Place your code below this line
def mkPoints(pts):
    dic={}
    def mkPoint(pt):
        ptX = pt[1]*1000
        ptY = pt[2]*1000
        ptZ = pt[3]*1000
        gpt = Point.ByCoordinates(ptX, ptY, ptZ)
        return gpt
    
    for x in pts:
        dic[str(x[0])] = mkPoint(x)
    return dic

result = mkPoints(input)
# Assign your output to the OUT variable.
OUT = result
# ----------------------------------------

# group: ELEMENT inform select
code_block_6 = CodeBlock(i=keys) { i[7]; }
code_block_7 = CodeBlock(i=splitdataasdict_불필요null_제거, j=code_block_6) { i[j]; }

removeHeadFromDict_2 = Python(IN[0]=code_block_7)  # CPython3; same code as removeHeadFromDict
code_block_8 = CodeBlock { "BEAM"; }
elementTypeFiltering = Python(IN[0]=removeHeadFromDict_2, IN[1]=code_block_8)  # CPython3
# ---------- elementTypeFiltering.python (24 lines) ----------
# Load the Python Standard and DesignScript Libraries
import sys
import clr
clr.AddReference('ProtoGeometry')
from Autodesk.DesignScript.Geometry import *

# The inputs to this node will be stored as a list in the IN variables.
dataEnteringNode = IN
input = IN[0]
inStr = IN[1]

# Place your code below this line

def filtering(data, instr, mode):
    if mode == "neg":
        res = list(filter(lambda x: instr not in str(x), data))
    else:
        res = list(filter(lambda x: instr in str(x), data))
    return res


result = filtering(input, inStr, "pos")
# Assign your output to the OUT variable.
OUT = result
# ----------------------------------------
mkCrvForMember = Python(IN[0]=다이나모_포인트로_변환_및_딕셔너리화, IN[1]=elementTypeFiltering)  # CPython3
# ---------- mkCrvForMember.python (33 lines) ----------
# Load the Python Standard and DesignScript Libraries
import sys
import clr
clr.AddReference('ProtoGeometry')
from Autodesk.DesignScript.Geometry import *

# The inputs to this node will be stored as a list in the IN variables.
dataEnteringNode = IN
inDic = IN[0]
input = IN[1]

# Place your code below this line

def mkCrvsForMember(pts_dic, elem_datas):
    dic = {}
    def mkCrv(pts_dic, x):
        sttPtName = str(x[4])
        endPtName = str(x[5])
        sttPt = inDic[sttPtName]
        endPt = inDic[endPtName]
        rs = Line.ByStartPointEndPoint(sttPt, endPt)
        return rs
    
#    for x in elem_datas:
#        dic[str(x[0])] = (x[3] ,mkCrv(pts_dic, x))
    res = list(map(lambda x: (x[3], mkCrv(pts_dic, x)), elem_datas))
    
    return res

result = mkCrvsForMember(inDic, input)

# Assign your output to the OUT variable.
OUT = result
# ----------------------------------------

# group: 배치 레벨 생성
level_생성_코드_실행여부 = BoolSelector(false)
엘리베이션_unique_추출 = Python(IN[0]=mkCrvForMember)  # CPython3
# ---------- 엘리베이션_unique_추출.python (20 lines) ----------
# Load the Python Standard and DesignScript Libraries
import sys
import clr
clr.AddReference('ProtoGeometry')
from Autodesk.DesignScript.Geometry import *

# The inputs to this node will be stored as a list in the IN variables.
dataEnteringNode = IN
input = IN[0]

# Place your code below this line
def find_unqElev(memberLines):
    tmp = map(lambda x: x[1].StartPoint.Z, memberLines)
    res = sorted(set(tmp))
    
    return res

result = find_unqElev(input)
# Assign your output to the OUT variable.
OUT = result
# ----------------------------------------
code_block_9 = CodeBlock { 300; }
배치기준레벨_자동생성 = Python(IN[0]=level_생성_코드_실행여부, IN[1]=엘리베이션_unique_추출, IN[2]=code_block_9)  # CPython3
# ---------- 배치기준레벨_자동생성.python (33 lines) ----------
# Load the Python Standard and DesignScript Libraries
import sys
import clr
clr.AddReference('ProtoGeometry')
from Autodesk.DesignScript.Geometry import *
import Revit
from RevitServices.Persistence import DocumentManager
from RevitServices.Transactions import TransactionManager
doc = DocumentManager.Instance.CurrentDBDocument

# The inputs to this node will be stored as a list in the IN variables.
dataEnteringNode = IN
exe_bln = IN[0]
input = IN[1]
fl = IN[2]
# Place your code below this line

def mkLevelsForMembers(elevs, fl, exe_bln):
    if exe_bln:
        flElevs = map(lambda x: x+fl*2, input)
        res = map(lambda x: Revit.Elements.Level.ByElevation(x), flElevs)
        return list(map(lambda x: x.SetParameterByName("S04) Level", "for placing"), res))
    else:
        pass
    

TransactionManager.Instance.EnsureInTransaction(doc)
result = mkLevelsForMembers(input, fl, exe_bln)
#result = list(map(lambda x: x.Elevation, mkLevelsForMembers(input, fl)))
TransactionManager.Instance.TransactionTaskDone()

# Assign your output to the OUT variable.
OUT = result
# ----------------------------------------

# group: 배치 레벨 선택(디버깅용)
categories = Categories("OST_Levels")
all_elements_of_category = ElementsOfCategory(Category=categories)
python_script = Python(IN[0]=all_elements_of_category)  # CPython3
# ---------- python_script.python (17 lines) ----------
# Load the Python Standard and DesignScript Libraries
import sys
import clr
clr.AddReference('ProtoGeometry')
from Autodesk.DesignScript.Geometry import *

# The inputs to this node will be stored as a list in the IN variables.
dataEnteringNode = IN

input = IN[0]

# Place your code below this line

result = filter(lambda x: x.GetParameterValueByName("S04) Level") == "for placing", input)

# Assign your output to the OUT variable.
OUT = result
# ----------------------------------------

mkCrvAndLevelDatas = Python(IN[0]=mkCrvForMember, IN[1]=python_script, IN[2]=code_block_9)  # CPython3
# ---------- mkCrvAndLevelDatas.python (51 lines) ----------
# Load the Python Standard and DesignScript Libraries
import sys
import clr
clr.AddReference('ProtoGeometry')
from Autodesk.DesignScript.Geometry import *

clr.AddReference('RevitAPI')
from Autodesk.Revit.DB import *
import Autodesk

clr.AddReference("RevitNodes")
import Revit
clr.ImportExtensions(Revit.Elements)
clr.ImportExtensions(Revit.GeometryConversion)

clr.AddReference('RevitServices')
import RevitServices
from RevitServices.Persistence import DocumentManager
doc = DocumentManager.Instance.CurrentDBDocument
collector = FilteredElementCollector(doc)

from DSCore import *


# The inputs to this node will be stored as a list in the IN variables.
dataEnteringNode = IN
input = IN[0]
levels = IN[1]
fl = IN[2]

# Place your code below this line

def mkCrvAndLevelDatas(memberDatas, levels):
    def mkElevAndLevelObjDic(levels):
        dic = {}
        for i in levels:
            dic[str(int(round(i.Elevation)))] = i
        return dic
    
    def find_Elev(memberData):
        res = memberData[1].StartPoint.Z + fl
        return str(int(round(res)))
    
    LvObjDic = mkElevAndLevelObjDic(levels)
    res = map(lambda x: List.AddItemToEnd(LvObjDic[find_Elev(x)], x), memberDatas)
    
    return list(res)
    
result = mkCrvAndLevelDatas(input, levels)
# Assign your output to the OUT variable.
OUT = result
# ----------------------------------------
select_all_levels_auto_created_ = Python()  # "select all levels(auto created)_디버깅용"; CPython3; frozen; unwired: IN[0]
# ---------- select_all_levels_auto_created_.python (32 lines) ----------
# Load the Python Standard and DesignScript Libraries
import sys
import clr
clr.AddReference('ProtoGeometry')
from Autodesk.DesignScript.Geometry import *

clr.AddReference('RevitAPI')
from Autodesk.Revit.DB import *
import Autodesk

clr.AddReference("RevitNodes")
import Revit
clr.ImportExtensions(Revit.Elements)
clr.ImportExtensions(Revit.GeometryConversion)

clr.AddReference('RevitServices')
import RevitServices
from RevitServices.Persistence import DocumentManager
doc = DocumentManager.Instance.CurrentDBDocument
collector = FilteredElementCollector(doc)


# The inputs to this node will be stored as a list in the IN variables.
dataEnteringNode = IN

# Place your code below this line
_all_levs = collector.OfCategory(BuiltInCategory.OST_Levels).WhereElementIsNotElementType().ToElements()
all_levs = map(lambda x: x.ToDSType(True), _all_levs)

result = filter(lambda x: x.GetParameterValueByName("S04) Level") == "for placing", all_levs)
# Assign your output to the OUT variable.
OUT = list(result)
# ----------------------------------------

# group: SECTION inform select
# note: iPRO: 부재단면속성
# iN1: 시작점
# iN2: 끝점
code_block_10 = CodeBlock(i=keys) { i[0]; }
code_block_11 = CodeBlock(i=splitdataasdict_불필요null_제거, j=code_block_10) { i[j]; }

removeHeadFromDict_3 = Python(IN[0]=code_block_11)  # CPython3; same code as removeHeadFromDict
code_block_12 = CodeBlock { " --"; }
find_identifier_row_idx_2 = Python(IN[0]=removeHeadFromDict_3, IN[1]=code_block_12)  # CPython3
# ---------- find_identifier_row_idx_2.python (37 lines) ----------
# Load the Python Standard and DesignScript Libraries
import sys
import clr
clr.AddReference('ProtoGeometry')
from Autodesk.DesignScript.Geometry import *
from functools import reduce

# The inputs to this node will be stored as a list in the IN variables.
dataEnteringNode = IN

input = IN[0]
idf = IN[1]
# Place your code below this line

def find_tgrow_idx(tglst, idf, mode):
    if mode == "sttwith":
        def chck_identifier(x, idf):
            eres = str(x).startswith("['" + idf)
            return eres
            
    elif mode == "incld":
        def chck_identifier(x, idf):
            eres = str(x).find(idf)
            if eres >= 0:
                return True
            else:
                return False
        
    
    bln_res = list(map(lambda x: chck_identifier(x,idf), tglst))
    result = [i for i, x in enumerate(bln_res) if x]
    return result


result = find_tgrow_idx(input, idf, "incld")
# Assign your output to the OUT variable.
OUT = result
# ----------------------------------------
code_block_13 = CodeBlock { 2; }
splitdataasdict_불필요null_제거_2 = Python(IN[0]=removeHeadFromDict_3, IN[1]=find_identifier_row_idx_2, IN[2]=code_block_13)  # CPython3; same code as splitdataasdict_불필요null_제거

# group: Column inform select
# note: 13번 인덱스 가로
# 14번 인덱스 세로
code_block_14 = CodeBlock(i=splitdataasdict_불필요null_제거_2) { i; }
keys_2 = DesignScript.Builtin.Dictionary.Keys(dictionary=code_block_14)
code_block_15 = CodeBlock(i=keys_2) { i[3]; }
code_block_16 = CodeBlock(i=code_block_14, j=code_block_15) { i[j]; }

# group: defineFamilytypeName
unitFactor = CodeBlock { 1000; }
typePrefix = StringInput("CL111")
defineFamilytypeName = Python(IN[0]=code_block_16, IN[1]=unitFactor, IN[2]=typePrefix)  # CPython3
# ---------- defineFamilytypeName.python (28 lines) ----------
# Load the Python Standard and DesignScript Libraries
import sys
import clr
clr.AddReference('ProtoGeometry')
from Autodesk.DesignScript.Geometry import *

# The inputs to this node will be stored as a list in the IN variables.
dataEnteringNode = IN
input = IN[0]
unitFactor = IN[1]
typePrefix = IN[2]
# Place your code below this line

def defineFamilytypeName(memDatas, unitFactor, typePrefix):
    
    def findSize(memData):
        shrtSide = str(round(memData[13]*unitFactor))
        longSide = str(round(memData[14]*unitFactor))
        typeSuffix = memData[2].split()[0]
        return (shrtSide, longSide, typeSuffix)
    
    tmp = map(lambda x: findSize(x) ,memDatas)
    res = map(lambda x: typePrefix+"_" + 'x'.join([x[0], x[1]]) + "_" + x[2], tmp)
    return res

result = defineFamilytypeName(input, unitFactor, typePrefix)
# Assign your output to the OUT variable.
OUT = result
# ----------------------------------------

# group: 사용단면에 따른 패밀리 타입 생성
string_2 = StringInput("Concrete-Rectangular-Column_R1")
사용단면에_따른_패밀리_타입_생성 = Python(IN[0]=defineFamilytypeName, IN[1]=string_2)  # CPython3
# ---------- 사용단면에_따른_패밀리_타입_생성.python (57 lines) ----------
# Load the Python Standard and DesignScript Libraries
import sys
import clr
clr.AddReference('ProtoGeometry')
from Autodesk.DesignScript.Geometry import *
from Revit.Elements import *

clr.AddReference('RevitAPI')
from Autodesk.Revit.DB import *
import Autodesk

clr.AddReference("RevitNodes")
import Revit
clr.ImportExtensions(Revit.Elements)
clr.ImportExtensions(Revit.GeometryConversion)

import RevitServices
from RevitServices.Persistence import DocumentManager
from RevitServices.Transactions import TransactionManager
doc = DocumentManager.Instance.CurrentDBDocument

# The inputs to this node will be stored as a list in the IN variables.
dataEnteringNode = IN

symbolnames = IN[0]

family = UnwrapElement(Revit.Elements.Family.ByName(IN[1]))

# Place your code below this line
result = []

for s in symbolnames:
    chk = False
    
    fsCollector = FilteredElementCollector(doc)
    fsf = FamilySymbolFilter(family.Id)
    fsCollection = fsCollector.WherePasses(fsf).ToElements()
    
    for symbol in fsCollection:
        
        symbolname = symbol.get_Parameter(BuiltInParameter.SYMBOL_ID_PARAM).AsString()
        
        if symbolname == s:
            result.append(symbol.ToDSType(True))
            chk = True
            break
            
    if chk == False:
        TransactionManager.Instance.EnsureInTransaction(doc)
        
        newsymbol = fsCollection[0].Duplicate(s)
        result.append(newsymbol.ToDSType(True))
        
        TransactionManager.Instance.TransactionTaskDone()

# Assign your output to the OUT variable.
OUT = result
# ----------------------------------------

byFamilyNameAndTypeName = FamilyType.ByFamilyNameAndTypeName()  # unwired: familyName, typeName

# group: Beam inform select
code_block_17 = CodeBlock(i=splitdataasdict_불필요null_제거_2) { i; }
keys_3 = DesignScript.Builtin.Dictionary.Keys(dictionary=code_block_17)
code_block_18 = CodeBlock(i=keys_3) { i[2]; }
code_block_19 = CodeBlock(i=code_block_17, j=code_block_18) { i[j]; }

# group: defineFamilytypeName
unitFactor_2 = CodeBlock { 1000; }
typePrefix_2 = StringInput("BMS111_RC BEAM")
defineFamilytypeName_2 = Python(IN[0]=code_block_19, IN[1]=unitFactor_2, IN[2]=typePrefix_2)  # CPython3; same code as defineFamilytypeName

# group: 사용단면에 따른 패밀리 타입 생성
string_3 = StringInput("Concrete-Rectangular-Beam")
사용단면에_따른_패밀리_타입_생성_2 = Python(IN[0]=defineFamilytypeName_2, IN[1]=string_3)  # CPython3; same code as 사용단면에_따른_패밀리_타입_생성

# group: Girder inform select
code_block_20 = CodeBlock(i=splitdataasdict_불필요null_제거_2) { i; }
keys_4 = DesignScript.Builtin.Dictionary.Keys(dictionary=code_block_20)
code_block_21 = CodeBlock(i=keys_4) { i[1]; }
code_block_22 = CodeBlock(i=code_block_20, j=code_block_21) { i[j]; }

# group: defineFamilytypeName
unitFactor_3 = CodeBlock { 1000; }
typePrefix_3 = StringInput("BMS112_RC GIRDER")
defineFamilytypeName_3 = Python(IN[0]=code_block_22, IN[1]=unitFactor_3, IN[2]=typePrefix_3)  # CPython3; same code as defineFamilytypeName

# group: 사용단면에 따른 패밀리 타입 생성
string_4 = StringInput("Concrete-Rectangular-Beam")
사용단면에_따른_패밀리_타입_생성_3 = Python(IN[0]=defineFamilytypeName_3, IN[1]=string_4)  # CPython3; same code as 사용단면에_따른_패밀리_타입_생성

# group: Dummy inform select
code_block_23 = CodeBlock(i=splitdataasdict_불필요null_제거_2) { i; }
keys_5 = DesignScript.Builtin.Dictionary.Keys(dictionary=code_block_23)
code_block_24 = CodeBlock(i=keys_5) { i[0]; }
code_block_25 = CodeBlock(i=code_block_23, j=code_block_24) { i[j]; }

code_block_26 = CodeBlock { "Dummy"; }
elementTypeFiltering_2 = Python(IN[0]=code_block_25, IN[1]=code_block_26)  # CPython3
# ---------- elementTypeFiltering_2.python (24 lines) ----------
# Load the Python Standard and DesignScript Libraries
import sys
import clr
clr.AddReference('ProtoGeometry')
from Autodesk.DesignScript.Geometry import *

# The inputs to this node will be stored as a list in the IN variables.
dataEnteringNode = IN
input = IN[0]
inStr = IN[1]

# Place your code below this line

def filtering(data, instr, mode):
    if mode == "neg":
        res = list(filter(lambda x: instr not in str(x), data))
    else:
        res = list(filter(lambda x: instr in str(x), data))
    return res


result = filtering(input, inStr, "neg")
# Assign your output to the OUT variable.
OUT = result
# ----------------------------------------

# group: defineFamilytypeName
unitFactor_4 = CodeBlock { 1000; }
typePrefix_4 = StringInput("BMS112_RC GIRDER")
defineFamilytypeName_4 = Python(IN[0]=elementTypeFiltering_2, IN[1]=unitFactor_4, IN[2]=typePrefix_4)  # CPython3; same code as defineFamilytypeName

# group: 사용단면에 따른 패밀리 타입 생성
string_5 = StringInput("Concrete-Rectangular-Beam")
사용단면에_따른_패밀리_타입_생성_4 = Python(IN[0]=defineFamilytypeName_4, IN[1]=string_5)  # CPython3; same code as 사용단면에_따른_패밀리_타입_생성

values = DesignScript.Builtin.Dictionary.Values(dictionary=다이나모_포인트로_변환_및_딕셔너리화)
