# Dynamo graph midasSample_mxt_parsing_0523.dyn (Dynamo 2.12.0.5650)

# group: case2: csv format import
midasgen_excel_mxt_file_path = Filename(".\Midas_Sample.xlsx")
sheet_name = StringInput("Sample_Structure_Report")
initial_data_import = Python(IN[0]=midasgen_excel_mxt_file_path, IN[1]=sheet_name)  # CPython3; frozen
# ---------- initial_data_import.python (95 lines) ----------
# Load the Python Standard and DesignScript Libraries
import os
import sys
import re
import clr

python_rootpath = os.getenv('LOCALAPPDATA')+'\Programs\Python'
python_dir_list = os.listdir(python_rootpath)

p = re.compile('Python\d{2,5}')
version_list = list(filter(lambda x: p.match(x), python_dir_list))
version_num = list(map(lambda x: int(x[7:]), version_list))
latest_idx= version_num.index(max(version_num))

python_version = version_list[latest_idx]

sys.path.append(os.getenv('LOCALAPPDATA').replace('\\','\\\\') + f'\Programs\Python\{python_version}\Lib\site-packages')

clr.AddReference('ProtoGeometry')
from Autodesk.DesignScript.Geometry import *

from collections import Iterable
import datetime
import openpyxl

from itertools import chain
from functools import reduce

curry = lambda f: lambda a,*args: f(a, *args) if (len(args)) else lambda *args: f(a, *args)

add = curry(lambda a,b: a + b)

filter = curry(filter)
map = curry(map)

def _take(length, iter):
    res = []
    for a in iter:
        res.append(a)
        if len(res) == length:
            return res
take = curry(_take)
reduce = curry(reduce)
go = lambda *args: reduce(lambda a,f: f(a), args)

# The inputs to this node will be stored as a list in the IN variables.
dataEnteringNode = IN
inputFilePath = IN[0]
inputSheetName = IN[1]

# Place your code below this line

def importExcel(path, SheetNameIn):
    wb_obj = openpyxl.load_workbook(str(path), data_only=True)
    sheet_obj = wb_obj.get_sheet_by_name(str(SheetNameIn))

    m_row = sheet_obj.max_row
    m_col = sheet_obj.max_column

    listOut = []

    for i in range(1, m_row +1):
        listTemp = []
        for j in range(1, m_col + 1):
            cell_obj = sheet_obj.cell(row=i, column=j)
            listTemp.append(cell_obj.value)
            if len(listTemp) == m_col:
                listOut.append(listTemp)
    return listOut

def checkAllElement(list, target):
    tmp=[]
    for i in list:
        if i == target:
            tmp.append(True)
        else:
            tmp.append(False)
    return all(tmp)

rm_Null = lambda list: go(list,
    filter(lambda a: not checkAllElement(a, None)),
    )

s1 = importExcel(inputFilePath, inputSheetName)

s2 = rm_Null(s1)  ## null만 있는 Excel Row 제거

result_tr = list(zip(*s2))

s3 = rm_Null(result_tr) ## null만 있는 Excel Column 제거

result = list(zip(*s3))

# Assign your output to the OUT variable.
OUT = result
# ----------------------------------------

# group: case1: mxt format import
midasgen_mxt_file_path = Filename(".\Ulsan_STB_Steel_New_BOQ.mxt")  # graph input
boolean = BoolSelector(true)
importCSV = Data.ImportCSV(filePath=midasgen_mxt_file_path, transpose=boolean)
remove_null_row_column = Python(IN[0]=importCSV)  # CPython3
# ---------- remove_null_row_column.python (73 lines) ----------
# Load the Python Standard and DesignScript Libraries
import os
import sys
import re
import clr

#python_rootpath = os.getenv('LOCALAPPDATA')+'\Programs\Python'
#python_dir_list = os.listdir(python_rootpath)
#
#p = re.compile('Python\d{2,5}')
#version_list = list(filter(lambda x: p.match(x), python_dir_list))
#version_num = list(map(lambda x: int(x[7:]), version_list))
#latest_idx= version_num.index(max(version_num))
#
#python_version = version_list[latest_idx]
#
#sys.path.append(os.getenv('LOCALAPPDATA').replace('\\','\\\\') + f'\Programs\Python\{python_version}\Lib\site-packages')

clr.AddReference('ProtoGeometry')
from Autodesk.DesignScript.Geometry import *

from collections import Iterable
import datetime
#import openpyxl

from itertools import chain
from functools import reduce

curry = lambda f: lambda a,*args: f(a, *args) if (len(args)) else lambda *args: f(a, *args)

add = curry(lambda a,b: a + b)

filter = curry(filter)
map = curry(map)

def _take(length, iter):
    res = []
    for a in iter:
        res.append(a)
        if len(res) == length:
            return res
take = curry(_take)
reduce = curry(reduce)
go = lambda *args: reduce(lambda a,f: f(a), args)

# The inputs to this node will be stored as a list in the IN variables.
dataEnteringNode = IN
inputData = IN[0]
# Place your code below this line
def checkAllElement(list, target):
    tmp=[]
    for i in list:
        if i == target:
            tmp.append(True)
        else:
            tmp.append(False)
    return all(tmp)

rm_Null = lambda list: go(list,
    filter(lambda a: not checkAllElement(a, None)),
    )

s1 = inputData

s2 = rm_Null(s1)  ## null만 있는 Excel Row 제거

result_tr = list(zip(*s2))

s3 = rm_Null(result_tr) ## null만 있는 Excel Column 제거

result = list(zip(*s3))
# Assign your output to the OUT variable.
OUT = result
# ----------------------------------------

code_block = CodeBlock { "*"; }
find_identifier_row_idx = Python(IN[0]=remove_null_row_column, IN[1]=code_block)  # CPython3
# ---------- find_identifier_row_idx.python (37 lines) ----------
# Load the Python Standard and DesignScript Libraries
import sys
import clr
clr.AddReference('ProtoGeometry')
from Autodesk.DesignScript.Geometry import *
from functools import reduce

# The inputs to this node will be stored as a list in the IN variables.
dataEnteringNode = IN

input = IN[0]
idf = IN[1]
# Place your code below this line

def find_tgrow_idx(tglst, idf, mode):
    if mode == "sttwith":
        def chck_identifier(x, idf):
            eres = str(x).startswith("['" + idf)
            return eres
            
    elif mode == "incld":
        def chck_identifier(x, idf):
            eres = str(x).find(idf)
            if eres >= 0:
                return True
            else:
                return False
        
    
    bln_res = list(map(lambda x: chck_identifier(x,idf), tglst))
    result = [i for i, x in enumerate(bln_res) if x]
    return result


result = find_tgrow_idx(input, idf, "sttwith")
# Assign your output to the OUT variable.
OUT = result
# ----------------------------------------
code_block_2 = CodeBlock { -1; }
dropItems = List.DropItems(list=find_identifier_row_idx, amount=code_block_2)
code_block_3 = CodeBlock { 0; }
splitdataasdict_불필요null_제거 = Python(IN[0]=remove_null_row_column, IN[1]=dropItems, IN[2]=code_block_3)  # CPython3
# ---------- splitdataasdict_불필요null_제거.python (72 lines) ----------
# Load the Python Standard and DesignScript Libraries
import sys
import clr
clr.AddReference('ProtoGeometry')
from Autodesk.DesignScript.Geometry import *
from functools import reduce

curry = lambda f: lambda a,*args: f(a, *args) if (len(args)) else lambda *args: f(a, *args)

add = curry(lambda a,b: a + b)

filter = curry(filter)
map = curry(map)

def _take(length, iter):
    res = []
    for a in iter:
        res.append(a)
        if len(res) == length:
            return res
take = curry(_take)
reduce = curry(reduce)
go = lambda *args: reduce(lambda a,f: f(a), args)

def checkAllElement(list, target):
    tmp=[]
    for i in list:
        if i == target:
            tmp.append(True)
        else:
            tmp.append(False)
    return all(tmp)

rm_Null = lambda list: go(list,
    filter(lambda a: not checkAllElement(a, None)),
    )

# The inputs to this node will be stored as a list in the IN variables.
dataEnteringNode = IN

input = IN[0]
split_idx = IN[1]
key_idx = IN[2]

# Place your code below this line
def splitDataAsDict(split_idx, data, key_idx):

    def calc_range(split_idx):
        res = []
        for i,x in enumerate(split_idx):
            if i < len(split_idx)-1:
                res.append((x, split_idx[i+1]))
            else:
                res.append((x, len(input)))
        return res
    
    range = calc_range(split_idx)

    result = []
    dic = {}
    for x in range:
        key = str(data[x[0]][key_idx]).split('    ;')[0]
        val1 = data[x[0]+1:x[1]]
        val_tr = list(zip(*val1))
        val = list(zip(*rm_Null(val_tr)))
        dic[str(key)] = val
    return dic

result = splitDataAsDict(split_idx, input, key_idx)

# Assign your output to the OUT variable.
OUT = result
# ----------------------------------------
keys = DesignScript.Builtin.Dictionary.Keys(dictionary=splitdataasdict_불필요null_제거)

# group: NODE inform select
code_block_4 = CodeBlock { "NODE"; }
inform_select = Python(IN[0]=splitdataasdict_불필요null_제거, IN[1]=code_block_4)  # CPython3
# ---------- inform_select.python (22 lines) ----------
# Load the Python Standard and DesignScript Libraries
import sys
import clr
clr.AddReference('ProtoGeometry')
from Autodesk.DesignScript.Geometry import *

# The inputs to this node will be stored as a list in the IN variables.
dataEnteringNode = IN
inputDic = IN[0]
keyStr = IN[1]

# Place your code below this line

def informSelect(inputDic, keyStr):
    titles = inputDic.keys()
    res = filter(lambda x: keyStr in x, titles)
    targetKey = list(res)[0]
    return inputDic[targetKey]

result = informSelect(inputDic, keyStr)
# Assign your output to the OUT variable.
OUT = result
# ----------------------------------------

removeHeadFromDict = Python(IN[0]=inform_select)  # CPython3
# ---------- removeHeadFromDict.python (39 lines) ----------
# Load the Python Standard and DesignScript Libraries
import sys
import clr
clr.AddReference('ProtoGeometry')
from Autodesk.DesignScript.Geometry import *
from functools import reduce

# The inputs to this node will be stored as a list in the IN variables.
dataEnteringNode = IN

input = IN[0]

# Place your code below this line

def find_tgrow_idx(tglst, idf):

    def chck_identifier(tglst, idf):
        eres = list(map(lambda x: str(x).find(idf), tglst)) 
        res = reduce(lambda a,b: a*b, eres)
        if res == 0:
            return True
    
    bln_res = list(map(lambda x: chck_identifier(x,idf), tglst))
    result = [i for i, x in enumerate(bln_res) if x == True]
    return result

def removeHeadFromDict(tglst, idf):
    result = []
    del_idx = find_tgrow_idx(tglst,idf)
    for i,x in enumerate(tglst):
        if i in del_idx:
            pass
        else:
            result.append(x)
    return result

result = removeHeadFromDict(input,';')
# Assign your output to the OUT variable.
OUT = result
# ----------------------------------------
원점정하고_좌표계변환_단위_m_mm = Python(IN[0]=removeHeadFromDict)  # CPython3
# ---------- 원점정하고_좌표계변환_단위_m_mm.python (34 lines) ----------
# Load the Python Standard and DesignScript Libraries
import sys
import clr
clr.AddReference('ProtoGeometry')
from Autodesk.DesignScript.Geometry import *

# The inputs to this node will be stored as a list in the IN variables.
dataEnteringNode = IN
input = IN[0]

# Place your code below this line
def findOrigin(pts):
    origin = pts[0]
    
    ori_ptX = origin[1]
    ori_ptY = origin[2]
    ori_pyZ = origin[3]
    origin = (ori_ptX, ori_ptY, ori_pyZ)
    
    return origin

def trnslt_pt(pts, origin):
    def set_trPt(pt):
        res = (pt[0], pt[1]-origin[0], pt[2]-origin[1], pt[3]-origin[2])
        return res
        
    result = list(map(lambda x: set_trPt(x), pts))
    return result

origin = findOrigin(input)
result = trnslt_pt(input, origin)

# Assign your output to the OUT variable.
OUT = result
# ----------------------------------------
다이나모_포인트로_변환_및_딕셔너리화 = Python(IN[0]=원점정하고_좌표계변환_단위_m_mm)  # CPython3
# ---------- 다이나모_포인트로_변환_및_딕셔너리화.python (26 lines) ----------
# Load the Python Standard and DesignScript Libraries
import sys
import clr
clr.AddReference('ProtoGeometry')
from Autodesk.DesignScript.Geometry import *

# The inputs to this node will be stored as a list in the IN variables.
dataEnteringNode = IN
input = IN[0]
# Place your code below this line
def mkPoints(pts):
    dic={}
    def mkPoint(pt):
        ptX = pt[1]*1000
        ptY = pt[2]*1000
        ptZ = pt[3]*1000
        gpt = Point.ByCoordinates(ptX, ptY, ptZ)
        return gpt
    
    for x in pts:
        dic[str(x[0])] = mkPoint(x)
    return dic

result = mkPoints(input)
# Assign your output to the OUT variable.
OUT = result
# ----------------------------------------
values = DesignScript.Builtin.Dictionary.Values(dictionary=다이나모_포인트로_변환_및_딕셔너리화)

# group: SECTION inform select
# note: iPRO: 부재단면속성
# iN1: 시작점
# iN2: 끝점
code_block_5 = CodeBlock { "SECTION"; }
inform_select_2 = Python(IN[0]=splitdataasdict_불필요null_제거, IN[1]=code_block_5)  # CPython3; same code as inform_select

removeHeadFromDict_2 = Python(IN[0]=inform_select_2)  # CPython3; same code as removeHeadFromDict
code_block_6 = CodeBlock { " --"; }
find_identifier_row_idx_2 = Python(IN[0]=removeHeadFromDict_2, IN[1]=code_block_6)  # CPython3
# ---------- find_identifier_row_idx_2.python (37 lines) ----------
# Load the Python Standard and DesignScript Libraries
import sys
import clr
clr.AddReference('ProtoGeometry')
from Autodesk.DesignScript.Geometry import *
from functools import reduce

# The inputs to this node will be stored as a list in the IN variables.
dataEnteringNode = IN

input = IN[0]
idf = IN[1]
# Place your code below this line

def find_tgrow_idx(tglst, idf, mode):
    if mode == "sttwith":
        def chck_identifier(x, idf):
            eres = str(x).startswith("['" + idf)
            return eres
            
    elif mode == "incld":
        def chck_identifier(x, idf):
            eres = str(x).find(idf)
            if eres >= 0:
                return True
            else:
                return False
        
    
    bln_res = list(map(lambda x: chck_identifier(x,idf), tglst))
    result = [i for i, x in enumerate(bln_res) if x]
    return result


result = find_tgrow_idx(input, idf, "incld")
# Assign your output to the OUT variable.
OUT = result
# ----------------------------------------
code_block_7 = CodeBlock { 2; }
splitdataasdict_불필요null_제거_2 = Python(IN[0]=removeHeadFromDict_2, IN[1]=find_identifier_row_idx_2, IN[2]=code_block_7)  # CPython3; same code as splitdataasdict_불필요null_제거

# group: Column inform select
# note: 13번 인덱스 가로
# 14번 인덱스 세로
code_block_8 = CodeBlock(i=splitdataasdict_불필요null_제거_2) { i; }
keys_2 = DesignScript.Builtin.Dictionary.Keys(dictionary=code_block_8)
code_block_9 = CodeBlock(i=keys_2) { i[6]; }
code_block_10 = CodeBlock(i=code_block_8, j=code_block_9) { i[j]; }

# group: defineFamilytypeName
unitFactor = CodeBlock { 1000; }
column_type_prefix = StringInput("CL111_RC COL")  # graph input
defineFamilytypeName = Python(IN[0]=code_block_10, IN[1]=unitFactor, IN[2]=column_type_prefix)  # CPython3
# ---------- defineFamilytypeName.python (29 lines) ----------
# Load the Python Standard and DesignScript Libraries
import sys
import clr
clr.AddReference('ProtoGeometry')
from Autodesk.DesignScript.Geometry import *

# The inputs to this node will be stored as a list in the IN variables.
dataEnteringNode = IN
input = IN[0]
unitFactor = IN[1]
typePrefix = IN[2]
# Place your code below this line

def defineFamilytypeName(memDatas, unitFactor, typePrefix):
    
    def findSize(memData):
        shrtSide = round(memData[13]*unitFactor)
        longSide = round(memData[14]*unitFactor)
        typeSuffix = memData[2].split()[0]
        secType = memData[0]
        return (shrtSide, longSide, typeSuffix, secType)
    
    tmp = map(lambda x: findSize(x) ,memDatas)
    res = map(lambda x: [typePrefix+"_" + 'x'.join([str(x[0]), str(x[1])]) + "_" + x[2], x[0], x[1], x[3]], tmp)
    return res

result = defineFamilytypeName(input, unitFactor, typePrefix)
# Assign your output to the OUT variable.
OUT = result
# ----------------------------------------

# group: 사용단면에 따른 패밀리 타입 생성
string = StringInput("Concrete-Rectangular-Column_R1")
paramNames = CodeBlock()
# ---------- paramNames.designscript (2 lines) ----------
["Length",
"Width"];
# ----------------------------------------
사용단면에_따른_패밀리_타입_생성 = Python(IN[0]=defineFamilytypeName, IN[1]=string, IN[2]=paramNames)  # CPython3; frozen
# ---------- 사용단면에_따른_패밀리_타입_생성.python (69 lines) ----------
# Load the Python Standard and DesignScript Libraries
import sys
import clr
clr.AddReference('ProtoGeometry')
from Autodesk.DesignScript.Geometry import *
from Revit.Elements import *

clr.AddReference('RevitAPI')
from Autodesk.Revit.DB import *
import Autodesk

clr.AddReference("RevitNodes")
import Revit
clr.ImportExtensions(Revit.Elements)
clr.ImportExtensions(Revit.GeometryConversion)

import RevitServices
from RevitServices.Persistence import DocumentManager
from RevitServices.Transactions import TransactionManager
doc = DocumentManager.Instance.CurrentDBDocument

# The inputs to this node will be stored as a list in the IN variables.
dataEnteringNode = IN
symbolDatas = IN[0]
symbolnames = map(lambda x: x[0], symbolDatas)
family = UnwrapElement(Revit.Elements.Family.ByName(IN[1]))
paramNames = IN[2]

# Place your code below this line
typeList = []

for s in symbolnames:
    chk = False
    
    fsCollector = FilteredElementCollector(doc)
    fsf = FamilySymbolFilter(family.Id)
    fsCollection = fsCollector.WherePasses(fsf).ToElements()
    
    for symbol in fsCollection:
        
        symbolname = symbol.get_Parameter(BuiltInParameter.SYMBOL_ID_PARAM).AsString()
        
        if symbolname == s:
            typeList.append(symbol.ToDSType(True))
            chk = True
            break
            
    if chk == False:
        TransactionManager.Instance.EnsureInTransaction(doc)
        
        newsymbol = fsCollection[0].Duplicate(s)
        typeList.append(newsymbol.ToDSType(True))
        
        TransactionManager.Instance.TransactionTaskDone()



TransactionManager.Instance.EnsureInTransaction(doc)
result = {}
for i,x in enumerate(typeList):
    for j,y in enumerate(paramNames):
        x.SetParameterByName(y, symbolDatas[i][j+1])
    
    res = x.SetParameterByName("Type Comments", "for placing")
    result[str(symbolDatas[i][3])] = res
TransactionManager.Instance.TransactionTaskDone()

# Assign your output to the OUT variable.
OUT = result
# ----------------------------------------

# group: Beam inform select
code_block_11 = CodeBlock(i=splitdataasdict_불필요null_제거_2) { i; }
keys_3 = DesignScript.Builtin.Dictionary.Keys(dictionary=code_block_11)
code_block_12 = CodeBlock(i=keys_3) { i[2]; }
code_block_13 = CodeBlock(i=code_block_11, j=code_block_12) { i[j]; }

# group: defineFamilytypeName
unitFactor_2 = CodeBlock { 1000; }
beam_typeprefix = StringInput("BMS111_RC BEAM")  # graph input
defineFamilytypeName_2 = Python(IN[0]=code_block_13, IN[1]=unitFactor_2, IN[2]=beam_typeprefix)  # CPython3; same code as defineFamilytypeName

# group: 사용단면에 따른 패밀리 타입 생성
string_2 = StringInput("Concrete-Rectangular-Beam")
paramNames_2 = CodeBlock()
# ---------- paramNames_2.designscript (2 lines) ----------
["Height",
"Width"];
# ----------------------------------------
사용단면에_따른_패밀리_타입_생성_2 = Python(IN[0]=defineFamilytypeName_2, IN[1]=string_2, IN[2]=paramNames_2)  # CPython3; frozen; same code as 사용단면에_따른_패밀리_타입_생성

# group: Girder inform select
code_block_14 = CodeBlock(i=splitdataasdict_불필요null_제거_2) { i; }
keys_4 = DesignScript.Builtin.Dictionary.Keys(dictionary=code_block_14)
code_block_15 = CodeBlock(i=keys_4) { i[1]; }
code_block_16 = CodeBlock(i=code_block_14, j=code_block_15) { i[j]; }

# group: defineFamilytypeName
unitFactor_3 = CodeBlock { 1000; }
girder_typeprefix = StringInput("BMS112_RC GIRDER")  # graph input
defineFamilytypeName_3 = Python(IN[0]=code_block_16, IN[1]=unitFactor_3, IN[2]=girder_typeprefix)  # CPython3; frozen; same code as defineFamilytypeName

# group: 사용단면에 따른 패밀리 타입 생성
string_3 = StringInput("Concrete-Rectangular-Beam")
paramNames_3 = CodeBlock()  # same code as paramNames_2
사용단면에_따른_패밀리_타입_생성_3 = Python(IN[0]=defineFamilytypeName_3, IN[1]=string_3, IN[2]=paramNames_3)  # CPython3; same code as 사용단면에_따른_패밀리_타입_생성

# group: Dummy inform select
code_block_17 = CodeBlock(i=splitdataasdict_불필요null_제거_2) { i; }
keys_5 = DesignScript.Builtin.Dictionary.Keys(dictionary=code_block_17)
code_block_18 = CodeBlock(i=keys_5) { i[0]; }
code_block_19 = CodeBlock(i=code_block_17, j=code_block_18) { i[j]; }

code_block_20 = CodeBlock { "Dummy"; }
elementTypeFiltering = Python(IN[0]=code_block_19, IN[1]=code_block_20)  # CPython3
# ---------- elementTypeFiltering.python (24 lines) ----------
# Load the Python Standard and DesignScript Libraries
import sys
import clr
clr.AddReference('ProtoGeometry')
from Autodesk.DesignScript.Geometry import *

# The inputs to this node will be stored as a list in the IN variables.
dataEnteringNode = IN
input = IN[0]
inStr = IN[1]

# Place your code below this line

def filtering(data, instr, mode):
    if mode == "neg":
        res = list(filter(lambda x: instr not in str(x), data))
    else:
        res = list(filter(lambda x: instr in str(x), data))
    return res


result = filtering(input, inStr, "neg")
# Assign your output to the OUT variable.
OUT = result
# ----------------------------------------

# group: defineFamilytypeName
unitFactor_4 = CodeBlock { 1000; }
other_typeprefix = StringInput("BMS112_RC GIRDER")  # graph input
defineFamilytypeName_4 = Python(IN[0]=elementTypeFiltering, IN[1]=unitFactor_4, IN[2]=other_typeprefix)  # CPython3; frozen; same code as defineFamilytypeName

# group: 사용단면에 따른 패밀리 타입 생성
string_4 = StringInput("Concrete-Rectangular-Beam")
paramNames_4 = CodeBlock()  # same code as paramNames_2
사용단면에_따른_패밀리_타입_생성_4 = Python(IN[0]=defineFamilytypeName_4, IN[1]=string_4, IN[2]=paramNames_4)  # CPython3; same code as 사용단면에_따른_패밀리_타입_생성

dictionary_병합 = Python(IN[0]=사용단면에_따른_패밀리_타입_생성, IN[1]=사용단면에_따른_패밀리_타입_생성_2, IN[2]=사용단면에_따른_패밀리_타입_생성_3, IN[3]=사용단면에_따른_패밀리_타입_생성_4)  # CPython3
# ---------- dictionary_병합.python (19 lines) ----------
# Load the Python Standard and DesignScript Libraries
import sys
import clr
clr.AddReference('ProtoGeometry')
from Autodesk.DesignScript.Geometry import *
from functools import reduce

# The inputs to this node will be stored as a list in the IN variables.
dataEnteringNode = IN


# Place your code below this line
def mergeDict(dict1, dict2):
    res = dict(dict2, **dict1)
    return res

result = reduce(mergeDict, IN)
# Assign your output to the OUT variable.
OUT = result
# ----------------------------------------

# group: ELEMENT inform select
code_block_21 = CodeBlock { "ELEMENT"; }
inform_select_3 = Python(IN[0]=splitdataasdict_불필요null_제거, IN[1]=code_block_21)  # CPython3; same code as inform_select

removeHeadFromDict_3 = Python(IN[0]=inform_select_3)  # CPython3; same code as removeHeadFromDict
plate요소_제외 = CodeBlock { "PLATE"; }
elementTypeFiltering_2 = Python(IN[0]=removeHeadFromDict_3, IN[1]=plate요소_제외)  # CPython3; same code as elementTypeFiltering
mkCrvForMember = Python(IN[0]=다이나모_포인트로_변환_및_딕셔너리화, IN[1]=elementTypeFiltering_2)  # CPython3
# ---------- mkCrvForMember.python (33 lines) ----------
# Load the Python Standard and DesignScript Libraries
import sys
import clr
clr.AddReference('ProtoGeometry')
from Autodesk.DesignScript.Geometry import *

# The inputs to this node will be stored as a list in the IN variables.
dataEnteringNode = IN
inDic = IN[0]
input = IN[1]

# Place your code below this line

def mkCrvsForMember(pts_dic, elem_datas):
    dic = {}
    def mkCrv(pts_dic, x):
        sttPtName = str(x[4])
        endPtName = str(x[5])
        sttPt = inDic[sttPtName]
        endPt = inDic[endPtName]
        rs = Line.ByStartPointEndPoint(sttPt, endPt)
        return rs
    
#    for x in elem_datas:
#        dic[str(x[0])] = (x[3] ,mkCrv(pts_dic, x))
    res = list(map(lambda x: (x[3], mkCrv(pts_dic, x)), elem_datas))
    
    return res

result = mkCrvsForMember(inDic, input)

# Assign your output to the OUT variable.
OUT = result
# ----------------------------------------

# group: 배치 레벨 선택(디버깅용)
categories = Categories("OST_Levels")
all_elements_of_category = ElementsOfCategory(Category=categories)
python_script = Python(IN[0]=all_elements_of_category)  # CPython3
# ---------- python_script.python (17 lines) ----------
# Load the Python Standard and DesignScript Libraries
import sys
import clr
clr.AddReference('ProtoGeometry')
from Autodesk.DesignScript.Geometry import *

# The inputs to this node will be stored as a list in the IN variables.
dataEnteringNode = IN

input = IN[0]

# Place your code below this line

result = filter(lambda x: x.GetParameterValueByName("S04) Level") == "for placing", input)

# Assign your output to the OUT variable.
OUT = result
# ----------------------------------------

# group: 배치 레벨 생성
level_생성_코드_실행여부 = BoolSelector(true)
엘리베이션_unique_추출 = Python(IN[0]=mkCrvForMember)  # CPython3
# ---------- 엘리베이션_unique_추출.python (20 lines) ----------
# Load the Python Standard and DesignScript Libraries
import sys
import clr
clr.AddReference('ProtoGeometry')
from Autodesk.DesignScript.Geometry import *

# The inputs to this node will be stored as a list in the IN variables.
dataEnteringNode = IN
input = IN[0]

# Place your code below this line
def find_unqElev(memberLines):
    tmp = map(lambda x: x[1].StartPoint.Z, memberLines)
    res = sorted(set(tmp))
    
    return res

result = find_unqElev(input)
# Assign your output to the OUT variable.
OUT = result
# ----------------------------------------
fl_offset = DoubleInput(300)  # graph input
배치기준레벨_자동생성 = Python(IN[0]=level_생성_코드_실행여부, IN[1]=엘리베이션_unique_추출, IN[2]=fl_offset)  # CPython3; frozen
# ---------- 배치기준레벨_자동생성.python (33 lines) ----------
# Load the Python Standard and DesignScript Libraries
import sys
import clr
clr.AddReference('ProtoGeometry')
from Autodesk.DesignScript.Geometry import *
import Revit
from RevitServices.Persistence import DocumentManager
from RevitServices.Transactions import TransactionManager
doc = DocumentManager.Instance.CurrentDBDocument

# The inputs to this node will be stored as a list in the IN variables.
dataEnteringNode = IN
exe_bln = IN[0]
input = IN[1]
fl = IN[2]
# Place your code below this line

def mkLevelsForMembers(elevs, fl, exe_bln):
    if exe_bln:
        flElevs = map(lambda x: x+fl*2, input)
        res = map(lambda x: Revit.Elements.Level.ByElevation(x), flElevs)
        return list(map(lambda x: x.SetParameterByName("S04) Level", "for placing"), res))
    else:
        pass
    

TransactionManager.Instance.EnsureInTransaction(doc)
result = mkLevelsForMembers(input, fl, exe_bln)
#result = list(map(lambda x: x.Elevation, mkLevelsForMembers(input, fl)))
TransactionManager.Instance.TransactionTaskDone()

# Assign your output to the OUT variable.
OUT = result
# ----------------------------------------

code_block_22 = CodeBlock(i=python_script, j=배치기준레벨_자동생성) { i; j; }
mkCrvAndLevelDatas = Python(IN[0]=mkCrvForMember, IN[1]=code_block_22.j, IN[2]=fl_offset)  # CPython3
# ---------- mkCrvAndLevelDatas.python (52 lines) ----------
# Load the Python Standard and DesignScript Libraries
import sys
import clr
clr.AddReference('ProtoGeometry')
from Autodesk.DesignScript.Geometry import *

clr.AddReference('RevitAPI')
from Autodesk.Revit.DB import *
import Autodesk

clr.AddReference("RevitNodes")
import Revit
clr.ImportExtensions(Revit.Elements)
clr.ImportExtensions(Revit.GeometryConversion)

clr.AddReference('RevitServices')
import RevitServices
from RevitServices.Persistence import DocumentManager
doc = DocumentManager.Instance.CurrentDBDocument
collector = FilteredElementCollector(doc)

from DSCore import *


# The inputs to this node will be stored as a list in the IN variables.
dataEnteringNode = IN
input = IN[0]
levels = IN[1]
fl = IN[2]

# Place your code below this line

def mkCrvAndLevelDatas(memberDatas, levels):
    def mkElevAndLevelObjDic(levels):
        dic = {}
        for i,x in enumerate(levels):
            dic[str(int(round(x.Elevation)))] = x
        return dic
    
    def find_Elev(memberData):
        stt_res = memberData[1].StartPoint.Z + fl
        end_res = memberData[1].EndPoint.Z + fl
        return (str(int(round(stt_res))), str(int(round(end_res))))
    
    LvObjDic = mkElevAndLevelObjDic(levels)
    res = map(lambda x: List.AddItemToEnd((LvObjDic[find_Elev(x)[0]], LvObjDic[find_Elev(x)[1]]), x), memberDatas)
    
    return list(res)
    
result = mkCrvAndLevelDatas(input, levels)
# Assign your output to the OUT variable.
OUT = result
# ----------------------------------------
mkSet_CrvLvType = Python(IN[0]=dictionary_병합, IN[1]=mkCrvAndLevelDatas)  # CPython3
# ---------- mkSet_CrvLvType.python (39 lines) ----------
# Load the Python Standard and DesignScript Libraries
import sys
import clr
clr.AddReference('ProtoGeometry')
from Autodesk.DesignScript.Geometry import *

clr.AddReference('RevitAPI')
from Autodesk.Revit.DB import *
import Autodesk

clr.AddReference("RevitNodes")
import Revit
clr.ImportExtensions(Revit.Elements)
clr.ImportExtensions(Revit.GeometryConversion)

clr.AddReference('RevitServices')
import RevitServices
from RevitServices.Persistence import DocumentManager
doc = DocumentManager.Instance.CurrentDBDocument
collector = FilteredElementCollector(doc)

from DSCore import *


# The inputs to this node will be stored as a list in the IN variables.
dataEnteringNode = IN
typeDic = IN[0]
CrvAndLevelDatas = IN[1]


# Place your code below this line

def mkSet_CrvLvType(typeDic, CrvAndLevelDatas):
    res = map(lambda x: List.AddItemToEnd(typeDic[str(x[0])], x),CrvAndLevelDatas)
    return res
    
result = mkSet_CrvLvType(typeDic, CrvAndLevelDatas)
# Assign your output to the OUT variable.
OUT = result
# ----------------------------------------
# note: 단면 회전 매개변수
# : Cross-Section Rotation
createRvtElem = Python(IN[0]=mkSet_CrvLvType)  # CPython3; graph output
# ---------- createRvtElem.python (64 lines) ----------
# Load the Python Standard and DesignScript Libraries
import sys
import clr
clr.AddReference('ProtoGeometry')
from Autodesk.DesignScript.Geometry import *

clr.AddReference('RevitAPI')
from Autodesk.Revit.DB import *
import Autodesk

clr.AddReference("RevitNodes")
import Revit
clr.ImportExtensions(Revit.Elements)
clr.ImportExtensions(Revit.GeometryConversion)

clr.AddReference('RevitServices')
import RevitServices
from RevitServices.Persistence import DocumentManager
doc = DocumentManager.Instance.CurrentDBDocument
collector = FilteredElementCollector(doc)

import RevitServices
from RevitServices.Persistence import DocumentManager
from RevitServices.Transactions import TransactionManager
doc = DocumentManager.Instance.CurrentDBDocument

from DSCore import *

# The inputs to this node will be stored as a list in the IN variables.
dataEnteringNode = IN
input = IN[0]

# Place your code below this line
def crtRvtElems(CrvLvTypes):
    def crtElem(CrvLvType):
        _crv = CrvLvType[1]
        _lv1 = CrvLvType[2][0]
        _lv2 = CrvLvType[2][1]
        _type = CrvLvType[3]
        _cat = CrvLvType[3].GetParameterValueByName("Category")
        
        if str(_cat) == "Structural Columns":
            res = Revit.Elements.StructuralFraming.ColumnByCurve(_crv, _lv1, _type)
            res.SetParameterByName("Top Level", _lv2)
            res.SetParameterByName("Base Offset", 0)
            res.SetParameterByName("Top Offset", 0)
        elif str(_cat) == "Structural Framing":
            res = Revit.Elements.StructuralFraming.BeamByCurve(_crv, _lv1, _type)
            res.SetParameterByName("Reference Level", _lv1)
            res.SetParameterByName("Start Level Offset", 0)
            res.SetParameterByName("End Level Offset", 0)
        else:
            pass
        
        return res
    res = map(lambda x: crtElem(x), CrvLvTypes)
    
    return res

TransactionManager.Instance.EnsureInTransaction(doc)
result = crtRvtElems(input)
TransactionManager.Instance.TransactionTaskDone()
# Assign your output to the OUT variable.
OUT = result
# ----------------------------------------
mkcrvformember_rotation_추가 = Python(IN[0]=다이나모_포인트로_변환_및_딕셔너리화, IN[1]=elementTypeFiltering_2)  # CPython3
# ---------- mkcrvformember_rotation_추가.python (33 lines) ----------
# Load the Python Standard and DesignScript Libraries
import sys
import clr
clr.AddReference('ProtoGeometry')
from Autodesk.DesignScript.Geometry import *

# The inputs to this node will be stored as a list in the IN variables.
dataEnteringNode = IN
inDic = IN[0]
input = IN[1]

# Place your code below this line

def mkCrvsForMember(pts_dic, elem_datas):
    dic = {}
    def mkCrv(pts_dic, x):
        sttPtName = str(x[4])
        endPtName = str(x[5])
        sttPt = inDic[sttPtName]
        endPt = inDic[endPtName]
        rs = Line.ByStartPointEndPoint(sttPt, endPt)
        return rs
    
#    for x in elem_datas:
#        dic[str(x[0])] = (x[3] ,mkCrv(pts_dic, x))
    res = list(map(lambda x: (x[3], mkCrv(pts_dic, x), x[6]), elem_datas))
    
    return res

result = mkCrvsForMember(inDic, input)

# Assign your output to the OUT variable.
OUT = result
# ----------------------------------------

# group: for debeg
all_framing_types = Python()  # CPython3; unwired: IN[0]
# ---------- all_framing_types.python (29 lines) ----------
# Load the Python Standard and DesignScript Libraries
import sys
import clr
clr.AddReference('ProtoGeometry')
from Autodesk.DesignScript.Geometry import *

clr.AddReference('RevitAPI')
from Autodesk.Revit.DB import *
import Autodesk

clr.AddReference('RevitServices')
import RevitServices
from RevitServices.Persistence import DocumentManager
doc = DocumentManager.Instance.CurrentDBDocument
collector = FilteredElementCollector(doc)

# The inputs to this node will be stored as a list in the IN variables.
dataEnteringNode = IN

# Place your code below this line

allTypeObjOfCat = collector.OfCategory(BuiltInCategory.OST_StructuralFraming).WhereElementIsElementType().ToElements()


allFamTypes = list(map(lambda x: x, allTypeObjOfCat))
allTypeNames = list(map(lambda x: x, allFamTypes))

# Assign your output to the OUT variable.
OUT = dir(allFamTypes[35])
# ----------------------------------------
all_framing_types_2 = Python()  # CPython3; unwired: IN[0]
# ---------- all_framing_types_2.python (29 lines) ----------
# Load the Python Standard and DesignScript Libraries
import sys
import clr
clr.AddReference('ProtoGeometry')
from Autodesk.DesignScript.Geometry import *

clr.AddReference('RevitAPI')
from Autodesk.Revit.DB import *
import Autodesk

clr.AddReference('RevitServices')
import RevitServices
from RevitServices.Persistence import DocumentManager
doc = DocumentManager.Instance.CurrentDBDocument
collector = FilteredElementCollector(doc)

# The inputs to this node will be stored as a list in the IN variables.
dataEnteringNode = IN

# Place your code below this line

allTypeObjOfCat = collector.OfCategory(BuiltInCategory.OST_StructuralFraming).WhereElementIsElementType().ToElements()


allFamTypes = list(map(lambda x: x, allTypeObjOfCat))
allTypeNames = list(map(lambda x: x, allFamTypes))

# Assign your output to the OUT variable.
OUT = allTypeObjOfCat[35].get_Name()
# ----------------------------------------

all_framing_types_3 = Python()  # CPython3; unwired: IN[0]
# ---------- all_framing_types_3.python (36 lines) ----------
# Load the Python Standard and DesignScript Libraries
import sys
import clr
clr.AddReference('ProtoGeometry')
from Autodesk.DesignScript.Geometry import *

clr.AddReference('RevitAPI')
from Autodesk.Revit.DB import *
import Autodesk

clr.AddReference('RevitServices')
import RevitServices
from RevitServices.Persistence import DocumentManager
doc = DocumentManager.Instance.CurrentDBDocument
collector = FilteredElementCollector(doc)

import re

# The inputs to this node will be stored as a list in the IN variables.
dataEnteringNode = IN

# Place your code below this line

allTypeObjOfCat = collector.OfCategory(BuiltInCategory.OST_StructuralFraming).WhereElementIsElementType().ToElements()


allFamTypeNames = map(lambda x: x.get_Name(), allTypeObjOfCat)
allTypeSize = map(lambda x: x.split('_'), allFamTypeNames)
p = re.compile('\d{1,}..x\d{1,}')


result = map(lambda x: p.finditer(x), allFamTypeNames)


# Assign your output to the OUT variable.
OUT = allTypeObjOfCat
# ----------------------------------------
parameters = Element.Parameters(element=all_framing_types_3)
all_col_types = Python()  # CPython3; unwired: IN[0]
# ---------- all_col_types.python (36 lines) ----------
# Load the Python Standard and DesignScript Libraries
import sys
import clr
clr.AddReference('ProtoGeometry')
from Autodesk.DesignScript.Geometry import *

clr.AddReference('RevitAPI')
from Autodesk.Revit.DB import *
import Autodesk

clr.AddReference('RevitServices')
import RevitServices
from RevitServices.Persistence import DocumentManager
doc = DocumentManager.Instance.CurrentDBDocument
collector = FilteredElementCollector(doc)

import re

# The inputs to this node will be stored as a list in the IN variables.
dataEnteringNode = IN

# Place your code below this line

allTypeObjOfCat = collector.OfCategory(BuiltInCategory.OST_StructuralColumns).WhereElementIsElementType().ToElements()


allFamTypeNames = map(lambda x: x.get_Name(), allTypeObjOfCat)
allTypeSize = map(lambda x: x.split('_'), allFamTypeNames)
p = re.compile('\d{1,}..x\d{1,}')


result = map(lambda x: p.finditer(x), allFamTypeNames)


# Assign your output to the OUT variable.
OUT = allTypeObjOfCat
# ----------------------------------------
parameters_2 = Element.Parameters(element=all_col_types)
code_block_23 = CodeBlock(i=parameters_2) { i[0]; }
parameterType = Parameter.ParameterType()  # unwired: parameter
group = Parameter.Group(parameter=parameters_2)
groupByKey = List.GroupByKey(list=parameters_2@L2, keys=group@L2)
test_groupbykey = Python(IN[0]=all_col_types)  # CPython3
# ---------- test_groupbykey.python (41 lines) ----------
# Load the Python Standard and DesignScript Libraries
import sys
import clr
clr.AddReference('ProtoGeometry')
from Autodesk.DesignScript.Geometry import *

clr.AddReference("RevitNodes")
import Revit
clr.ImportExtensions(Revit.Elements)
from Revit.Elements import ElementWrapper
import DSCore

# The inputs to this node will be stored as a list in the IN variables.
dataEnteringNode = IN
input = IN[0]
# Place your code below this line
parmsPerObjs = map(lambda x: x.Parameters, input)

def findGroupOfParam(_parmsPerObj):
    res = []
    for param in _parmsPerObj:
        res.append(param.Group)
    return res

#def getSizeFromRevitObj(_obj):
#    _list = _obj.Parameters
#    keysForGrouping = map(lambda x: x.Group, _list)
#    res = DSCore.List.GroupByKey(_list, keysForGrouping)
#    return res

def getSizeFromRevitObj(_obj):
    params = _obj.Parameters
    tmp = filter(lambda x: x.Group == "PG_GEOMETRY", params)

    return params


#result = List.GroupByKey(param,)

# Assign your output to the OUT variable.
OUT = map(getSizeFromRevitObj, input)
# ----------------------------------------

# group: All Column Types
all_column_types = Python()  # CPython3; unwired: IN[0]
# ---------- all_column_types.python (103 lines) ----------
# Load the Python Standard and DesignScript Libraries
import sys
import clr
clr.AddReference('ProtoGeometry')
from Autodesk.DesignScript.Geometry import *

clr.AddReference('RevitAPI')
from Autodesk.Revit.DB import *
import Autodesk

clr.AddReference('RevitServices')
import RevitServices
from RevitServices.Persistence import DocumentManager
doc = DocumentManager.Instance.CurrentDBDocument
collector = FilteredElementCollector(doc)

clr.AddReference("RevitNodes")
import Revit
clr.ImportExtensions(Revit.Elements)
from Revit.Elements import ElementWrapper
import DSCore

import re

# The inputs to this node will be stored as a list in the IN variables.
dataEnteringNode = IN

# Place your code below this line

allTypeObjOfCat = collector.OfCategory(BuiltInCategory.OST_StructuralColumns).WhereElementIsElementType().ToElements()

def mkFmtObj(_typeObj):
    _parts = _typeObj.get_Name().split('_')
        
    def selcByCond(_list, _idx):
        if _idx < len(_list):
            return _list[_idx]
        else:
            return "n/a"
    
    def findFmtCode(_list, _idx, _str):
        target = selcByCond(_list, _idx)
        p = re.compile(_str)
        if p.match(target):
            return target
        else:
            return "n/a"

    def findFmtType(_list, _idx):
        _target = selcByCond(_list, _idx)
        target = _target.split('-')
        return target

    def findFmtSize(_list, _str, _fmtType):
        target = selcByCond(_fmtType, 1)
        p = re.compile(_str)
        if target == "n/a":
            if len(_list) > 1:
                try:
                    target = list(filter(lambda x: p.match(x.replace(" ", "")), _list))[0]
                except:
                    target = "n/a"
            else:
                target = list(filter(lambda x: p.match(x.replace(" ", "")), _list))
        
        if isinstance(target, list):
            if len(target) > 0:
                return target[0]
            else:
                return target
        else:
            return target
    
#    def findFmtSize(_obj):
#        obj = _obj.ToDSType(True)
#        params = obj.Parameters
#        
#        tmp = filter(lambda x: x.Group == "PG_GEOMETRY", params)
#        res = map(lambda x: (x.get_Name(), x.get_Value()), tmp)
#
#        return tmp
                
    fmtCode = findFmtCode(_parts, 0, "\D{2,4}\d{2,4}")
    fmtType = findFmtType(_parts, 1)
    _fmtSize = findFmtSize(_parts, "\d", fmtType) #findFmtSize(_typeObj)
    fmtSize = ["n/a" if _fmtSize == [] else _fmtSize.replace('×','x')][0]
    fmtMark = ""
    fmtId = ""
    
    res = {
        "fmtObj": _typeObj,
        "fmtCode": fmtCode,
        "fmtType": fmtType[0],
        "fmtSize": fmtSize.split('x'),#["n/a" if fmtSize == [] else fmtSize.split('x')],
        "fmtMark": fmtMark,
        "fmtId": fmtId
    }
    
    return res


# Assign your output to the OUT variable.
OUT = map(mkFmtObj, allTypeObjOfCat)
# ----------------------------------------
validTypes = Python(IN[0]=all_column_types)  # CPython3
# ---------- validTypes.python (25 lines) ----------
# Load the Python Standard and DesignScript Libraries
import sys
import clr
clr.AddReference('ProtoGeometry')
from Autodesk.DesignScript.Geometry import *

# The inputs to this node will be stored as a list in the IN variables.
dataEnteringNode = IN
input = IN[0]
# Place your code below this line

def findValidObj(obj):
    targets = obj.values()

    def chk_na(targets):
        if "n/a" in targets:
            return False
        else:
            return True
    return chk_na(targets)


result = filter(findValidObj, input)
# Assign your output to the OUT variable.
OUT = result
# ----------------------------------------

# group: All Framing Types
all_framing_types_4 = Python()  # CPython3; unwired: IN[0]
# ---------- all_framing_types_4.python (104 lines) ----------
# Load the Python Standard and DesignScript Libraries
import sys
import clr
clr.AddReference('ProtoGeometry')
from Autodesk.DesignScript.Geometry import *

clr.AddReference('RevitAPI')
from Autodesk.Revit.DB import *
import Autodesk

clr.AddReference('RevitServices')
import RevitServices
from RevitServices.Persistence import DocumentManager
doc = DocumentManager.Instance.CurrentDBDocument
collector = FilteredElementCollector(doc)

clr.AddReference("RevitNodes")
import Revit
clr.ImportExtensions(Revit.Elements)
from Revit.Elements import ElementWrapper
import DSCore

import re

# The inputs to this node will be stored as a list in the IN variables.
dataEnteringNode = IN

# Place your code below this line

allTypeObjOfCat = collector.OfCategory(BuiltInCategory.OST_StructuralFraming).WhereElementIsElementType().ToElements()

def mkFmtObj(_typeObj):
    _parts = _typeObj.get_Name().split('_')
        
    def selcByCond(_list, _idx):
        if _idx < len(_list):
            return _list[_idx]
        else:
            return "n/a"
    
    def findFmtCode(_list, _idx, _str):
        target = selcByCond(_list, _idx)
        p = re.compile(_str)
        if p.match(target):
            return target
        else:
            return "n/a"

    def findFmtType(_list, _idx):
        _target = selcByCond(_list, _idx)
        target = _target.split('-')
        return target
        
        
    def findFmtSize(_list, _str, _fmtType):
        target = selcByCond(_fmtType, 1)
        p = re.compile(_str)
        if target == "n/a":
            if len(_list) > 1:
                try:
                    target = list(filter(lambda x: p.match(x.replace(" ", "")), _list))[0]
                except:
                    target = "n/a"
            else:
                target = list(filter(lambda x: p.match(x.replace(" ", "")), _list))
        
        if isinstance(target, list):
            if len(target) > 0:
                return target[0]
            else:
                return target
        else:
            return target
    
#    def findFmtSize(_obj):
#        obj = _obj.ToDSType(True)
#        params = obj.Parameters
#        
#        tmp = filter(lambda x: x.Group == "PG_GEOMETRY", params)
#        res = map(lambda x: (x.get_Name(), x.get_Value()), tmp)
#
#        return tmp
                
    fmtCode = findFmtCode(_parts, 0, "\D{2,4}\d{2,4}")
    fmtType = findFmtType(_parts, 1)
    _fmtSize = findFmtSize(_parts, "\d", fmtType) #findFmtSize(_typeObj)
    fmtSize = ["n/a" if _fmtSize == [] else _fmtSize.replace('×','x')][0]
    fmtMark = ""
    fmtId = ""
    
    res = {
        "fmtObj": _typeObj,
        "fmtCode": fmtCode,
        "fmtType": fmtType[0],
        "fmtSize": fmtSize.split('x'),#["n/a" if fmtSize == [] else fmtSize.split('x')],
        "fmtMark": fmtMark,
        "fmtId": fmtId
    }
    
    return res


# Assign your output to the OUT variable.
OUT = map(mkFmtObj, allTypeObjOfCat)
# ----------------------------------------
validTypes_2 = Python(IN[0]=all_framing_types_4)  # CPython3
# ---------- validTypes_2.python (35 lines) ----------
# Load the Python Standard and DesignScript Libraries
import sys
import clr
clr.AddReference('ProtoGeometry')
from Autodesk.DesignScript.Geometry import *

import copy

# The inputs to this node will be stored as a list in the IN variables.
dataEnteringNode = IN
input = IN[0]
# Place your code below this line

def findValidObj(obj):
    targets = obj.values()

    def chk_na(targets):
        if "n/a" in targets:
            return False
        else:
            return True
    return chk_na(targets)
result = filter(findValidObj, input)


def modiFmtSize(obj):
    return obj["fmtSize"].split('x')





#result = map(modiFmtSize, tmp)
# Assign your output to the OUT variable.
OUT = result
# ----------------------------------------

code_block_24 = CodeBlock(i=splitdataasdict_불필요null_제거_2) { i; }
mkSecObjFromMidas = Python(IN[0]=code_block_24)  # CPython3
# ---------- mkSecObjFromMidas.python (59 lines) ----------
# Load the Python Standard and DesignScript Libraries
import sys
import clr
clr.AddReference('ProtoGeometry')
from Autodesk.DesignScript.Geometry import *
from itertools import chain

# The inputs to this node will be stored as a list in the IN variables.
dataEnteringNode = IN
input = IN[0]
# Place your code below this line

#def mkSecObjFromMidas(_memTypeDicts):

def groupByMemType(_memTypeDicts, _str, _mode):
    keys = _memTypeDicts.keys()
    res = []
    if _mode == "pos":
        for x in keys:
            if _str in x:
                res.append(_memTypeDicts[x])
    elif _mode == "neg":
        for x in keys:
            tmp = []
            for y in _str:
                if y not in x:
                    tmp.append(True)
            if any(tmp):
                res.append(_memTypeDicts[x])
                    
    return list(chain(*res))



def mkSecDict(_grps):
    allCols = groupByMemType(_grps, "Steel/C-", "pos")
    allFrames = groupByMemType(_grps, ["Steel/C-", "/BR"], "neg")
    allBraces = groupByMemType(_grps, "/BR", "pos")
    
    def setDicAsGrp(_grp, _memberType):
        sectId = _grp[0]
        memberType = _memberType
        sectType = _grp[11]
        _sectSize = [_grp[13], _grp[14], _grp[15], _grp[16]]
        sectSize = map(lambda x: x*1000, _sectSize)
        
        res = {
            "sectId": sectId,
            "memberType": memberType,
            "sectType": sectType,
            "sectSize": sectSize,
        }
        return res
    return [map(lambda x: setDicAsGrp(x, "Column"), allCols), map(lambda x: setDicAsGrp(x, "Beam"), allFrames), map(lambda x: setDicAsGrp(x, "Brace"), allBraces)]


result = mkSecDict(input)
# Assign your output to the OUT variable.
OUT = result
# ----------------------------------------
test1 = Python(IN[0]=validTypes, IN[1]=validTypes_2, IN[2]=mkSecObjFromMidas)  # CPython3
# ---------- test1.python (55 lines) ----------
# Load the Python Standard and DesignScript Libraries
import sys
import clr
clr.AddReference('ProtoGeometry')
from Autodesk.DesignScript.Geometry import *

# The inputs to this node will be stored as a list in the IN variables.
dataEnteringNode = IN
allCols = IN[0]
allNonCols = IN[1]
mds_allCols = IN[2][0]
mds_allNonCols = IN[2][1]

# Place your code below this line

def compare_twoListByElem(_aList, _bList):
    _aListfilter = list(filter(lambda x: x!=0, _aList))
    _bListfilter = list(filter(lambda x: x!=0, _bList))
    if len(_aListfilter) == len(_bListfilter):
        tmp = []
        for i,x in enumerate(_aListfilter):
            if x == _bListfilter[i]:
                tmp.append(True)
            else:
                tmp.append(False)
        return all(tmp)
    else:
        return False

def matchFmlyWithMidasSection(_allCols, _allFrms, _mObj):
            
    def findFmtObj(_allElems, _mObj):
        res = []
        for x in _allElems:
            if _mObj["sectSize"] in x["fmtSize"]: ## 수정 필요
                res.append([_mObj["sectId"], x["fmtObj"]])
        return res
    
    sectId = _mObj["sectId"]
    fmtObj = 0
    
    res = {
        "sectId": sectId,
        "fmtObj": fmtObj,
    }
    
    return findFmtObj(_allCols, _mObj)
    
aList = map(float, allCols[72]["fmtSize"])
#aList = allCols[72]["fmtSize"]
bList = mds_allCols[0]["sectSize"]
result = compare_twoListByElem(aList, bList)
#result = compare_twoListByElem([1,2,3,4], [2,3,4,5])
# Assign your output to the OUT variable.
OUT = result
# ----------------------------------------
test2 = Python(IN[0]=validTypes, IN[1]=validTypes_2, IN[2]=mkSecObjFromMidas)  # CPython3
# ---------- test2.python (37 lines) ----------
# Load the Python Standard and DesignScript Libraries
import sys
import clr
clr.AddReference('ProtoGeometry')
from Autodesk.DesignScript.Geometry import *

# The inputs to this node will be stored as a list in the IN variables.
dataEnteringNode = IN
allCols = IN[0]
allNonCols = IN[1]
mds_allCols = IN[2][0]
mds_allNonCols = IN[2][1]

# Place your code below this line

def matchFmlyWithMidasSection(_allCols, _allFrms, _mObj):
    def findFmtObj(_allElems, _mObj):
        res = []
        for x in _allElems:
            if _mObj["sectSize"] in x["fmtSize"]: ##  수정 필요
                res.append([_mObj["sectId"], x["fmtObj"]])
        return res
    
    sectId = _mObj["sectId"]
    fmtObj = 0
    
    res = {
        "sectId": sectId,
        "fmtObj": fmtObj,
    }
    
    return findFmtObj(_allCols, _mObj)
    
floatFmtSize = map(float, allCols[72]["fmtSize"]) 
result = floatFmtSize
# Assign your output to the OUT variable.
OUT = result
# ----------------------------------------
matchFamilyWithMidasSection_col = Python(IN[0]=validTypes, IN[1]=validTypes_2, IN[2]=mkSecObjFromMidas)  # CPython3
# ---------- matchFamilyWithMidasSection_col.python (73 lines) ----------
# Load the Python Standard and DesignScript Libraries
import sys
import clr
clr.AddReference('ProtoGeometry')
from Autodesk.DesignScript.Geometry import *

# The inputs to this node will be stored as a list in the IN variables.
dataEnteringNode = IN
allCols = IN[0]
allNonCols = IN[1]
mds_allCols = IN[2][0]
mds_allNonCols = IN[2][1]

# Place your code below this line

def matchFmlyWithMidasSection(_allCols, _allFrms, _mObj):
    def compare_twoListByElem(_aList, _bList):
        _aListfilter = list(filter(lambda x: x!=0, _aList))
        _bListfilter = list(filter(lambda x: x!=0, _bList))
        
        if len(_aListfilter) == len(_bListfilter):
            tmp = []
            for i,x in enumerate(_aListfilter):
                if x == _bListfilter[i]:
                    tmp.append(True)
                else:
                    tmp.append(False)
            return all(tmp)
        else:
            return False
            
    def tryFloat(_list):
        res = []
        for x in _list:
            try:
                res.append(float(x))
            except:
                res.append(x)
        return res

    
    def findFmtObj(_allElems, _mObj):
        res = [_mObj["sectId"]]
        floatMobjSize = tryFloat(_mObj["sectSize"])
        
        for x in _allElems:
            floatFmtSize = tryFloat(x["fmtSize"])
            
            if compare_twoListByElem(floatMobjSize, floatFmtSize):
                res.append(x["fmtObj"])
            else:
                pass
        
        return res
    
    sectId = _mObj["sectId"]
    sectType = _mObj["sectType"]
    sectSize = _mObj["sectSize"]
    fmtObj = findFmtObj(_allCols, _mObj)
    
    res = {
        "sectId": sectId,
        "sectType": sectType,
        "sectSize": sectSize,
        "fmtObj": fmtObj,
    }
    
    return res

result = map(lambda x: matchFmlyWithMidasSection(allCols, allNonCols, x), mds_allCols)

# Assign your output to the OUT variable.
OUT = result
# ----------------------------------------
code_block_25 = CodeBlock { "fmtObj"; }
valueAtKey = DesignScript.Builtin.Dictionary.ValueAtKey(dictionary=matchFamilyWithMidasSection_col, key=code_block_25)
matchFamilyWithMidasSection_noncol = Python(IN[0]=validTypes, IN[1]=validTypes_2, IN[2]=mkSecObjFromMidas)  # CPython3
# ---------- matchFamilyWithMidasSection_noncol.python (73 lines) ----------
# Load the Python Standard and DesignScript Libraries
import sys
import clr
clr.AddReference('ProtoGeometry')
from Autodesk.DesignScript.Geometry import *

# The inputs to this node will be stored as a list in the IN variables.
dataEnteringNode = IN
allCols = IN[0]
allNonCols = IN[1]
mds_allCols = IN[2][0]
mds_allNonCols = IN[2][1]

# Place your code below this line

def matchFmlyWithMidasSection(_allCols, _allFrms, _mObj):
    def compare_twoListByElem(_aList, _bList):
        _aListfilter = list(filter(lambda x: x!=0, _aList))
        _bListfilter = list(filter(lambda x: x!=0, _bList))
        
        if len(_aListfilter) == len(_bListfilter):
            tmp = []
            for i,x in enumerate(_aListfilter):
                if x == _bListfilter[i]:
                    tmp.append(True)
                else:
                    tmp.append(False)
            return all(tmp)
        else:
            return False
            
    def tryFloat(_list):
        res = []
        for x in _list:
            try:
                res.append(float(x))
            except:
                res.append(x)
        return res

    
    def findFmtObj(_allElems, _mObj):
        res = [_mObj["sectId"]]
        floatMobjSize = tryFloat(_mObj["sectSize"])
        
        for x in _allElems:
            floatFmtSize = tryFloat(x["fmtSize"])
            
            if compare_twoListByElem(floatMobjSize, floatFmtSize):
                res.append(x["fmtObj"])
            else:
                pass
        
        return res
    
    sectId = _mObj["sectId"]
    sectType = _mObj["sectType"]
    sectSize = _mObj["sectSize"]
    fmtObj = findFmtObj(_allFrms, _mObj)
    
    res = {
        "sectId": sectId,
        "sectType": sectType,
        "sectSize": sectSize,
        "fmtObj": fmtObj,
    }
    
    return res

result = map(lambda x: matchFmlyWithMidasSection(allCols, allNonCols, x), mds_allNonCols)

# Assign your output to the OUT variable.
OUT = result
# ----------------------------------------
code_block_26 = CodeBlock { "fmtObj"; }
valueAtKey_2 = DesignScript.Builtin.Dictionary.ValueAtKey(dictionary=matchFamilyWithMidasSection_noncol, key=code_block_26)
# note: Brace도 따로 타입 걸러내기
matchFamilyWithMidasSection = Python(IN[0]=validTypes, IN[1]=validTypes_2, IN[2]=mkSecObjFromMidas)  # CPython3
# ---------- matchFamilyWithMidasSection.python (82 lines) ----------
# Load the Python Standard and DesignScript Libraries
import sys
import clr
clr.AddReference('ProtoGeometry')
from Autodesk.DesignScript.Geometry import *

# The inputs to this node will be stored as a list in the IN variables.
dataEnteringNode = IN
allCols = IN[0]
allNonCols = IN[1]
mds_allCols = IN[2][0]
mds_allFrames = IN[2][1]
mds_allBraces = IN[2][2]

# Place your code below this line

def matchFmlyWithMidasSection(_allCols, _allNonCols, _mObj):
    def compare_twoListByElem(_aList, _bList):
        _aListfilter = list(filter(lambda x: x!=0, _aList))
        _bListfilter = list(filter(lambda x: x!=0, _bList))
        
        if len(_aListfilter) == len(_bListfilter):
            tmp = []
            for i,x in enumerate(_aListfilter):
                if x == _bListfilter[i]:
                    tmp.append(True)
                else:
                    tmp.append(False)
            return all(tmp)
        else:
            return False
            
    def tryFloat(_list):
        res = []
        for x in _list:
            try:
                res.append(float(x))
            except:
                res.append(x)
        return res

    
    def findFmtObj(_allElems, _mObj):
        res = [_mObj["sectId"]]
        floatMobjSize = tryFloat(_mObj["sectSize"])
        
        for x in _allElems:
            floatFmtSize = tryFloat(x["fmtSize"])
            
            if compare_twoListByElem(floatMobjSize, floatFmtSize):
                res.append(x["fmtObj"])
            else:
                pass
        
        return res
    
    sectId = _mObj["sectId"]
    memberType = _mObj["memberType"]
    sectType = _mObj["sectType"]
    sectSize = _mObj["sectSize"]
    
    if memberType == "Column":
        fmtObj = findFmtObj(_allCols, _mObj)
    elif memberType == "Beam":
        fmtObj = findFmtObj(_allNonCols, _mObj)
    elif memberType == "Brace":
        fmtObj = findFmtObj(_allNonCols, _mObj)
    
    res = {
        "sectId": sectId,
        "memberType": memberType,
        "sectType": sectType,
        "sectSize": sectSize,
        "fmtObj": fmtObj,
    }
    
    return res

result = list(map(lambda x: matchFmlyWithMidasSection(allCols, allNonCols, x), mds_allCols)) + list(map(lambda x: matchFmlyWithMidasSection(allCols, allNonCols, x), mds_allFrames)) + list(map(lambda x: matchFmlyWithMidasSection(allCols, allNonCols, x), mds_allBraces))

# Assign your output to the OUT variable.
OUT = result
# ----------------------------------------
createFamily = Python(IN[0]=validTypes, IN[1]=validTypes_2, IN[2]=matchFamilyWithMidasSection)  # CPython3
# ---------- createFamily.python (134 lines) ----------
# Load the Python Standard and DesignScript Libraries
import sys
import clr
clr.AddReference('ProtoGeometry')
from Autodesk.DesignScript.Geometry import *

clr.AddReference('RevitAPI')
from Autodesk.Revit.DB import *
import Autodesk

clr.AddReference('RevitServices')
import RevitServices
from RevitServices.Persistence import DocumentManager
doc = DocumentManager.Instance.CurrentDBDocument
collector = FilteredElementCollector(doc)

clr.AddReference("RevitNodes")
import Revit
clr.ImportExtensions(Revit.Elements)
clr.ImportExtensions(Revit.GeometryConversion)

import RevitServices
from RevitServices.Persistence import DocumentManager
from RevitServices.Transactions import TransactionManager
doc = DocumentManager.Instance.CurrentDBDocument

# The inputs to this node will be stored as a list in the IN variables.
dataEnteringNode = IN
allCols = IN[0]
allNonCols = IN[1]
input = IN[2]

# Place your code below this line
def selectAllColTypes():
    collector = FilteredElementCollector(doc)
    res = collector.OfCategory(BuiltInCategory.OST_StructuralColumns).WhereElementIsElementType().ToElements()
    
    return res

def selectAllFrameTypes():
    collector = FilteredElementCollector(doc)
    res = collector.OfCategory(BuiltInCategory.OST_StructuralFraming).WhereElementIsElementType().ToElements()
    
    return res
    
allTypeObjOfCol = selectAllColTypes()
allTypeObjOfFrame = selectAllFrameTypes()

noMatchCol = list(filter(lambda x: "noMatch" in x.get_Name(), allTypeObjOfCol))[0]
noMatchBeam = list(filter(lambda x: "noMatch" in x.get_Name(), allTypeObjOfFrame))

def createFamilyType(_symbolnames, _motherFamilyName):
    typeList = []

    for s in symbolnames:
        chk = False
        
        fsCollector = FilteredElementCollector(doc)
        fsf = FamilySymbolFilter(family.Id)
        fsCollection = fsCollector.WherePasses(fsf).ToElements()
        
        for symbol in fsCollection:
            
            symbolname = symbol.get_Parameter(BuiltInParameter.SYMBOL_ID_PARAM).AsString()
            
            if symbolname == s:
                typeList.append(symbol.ToDSType(True))
                chk = True
                break
                
        if chk == False:
            TransactionManager.Instance.EnsureInTransaction(doc)
            
            newsymbol = fsCollection[0].Duplicate(s)
            typeList.append(newsymbol.ToDSType(True))
            
            TransactionManager.Instance.TransactionTaskDone()
    
    
    
    TransactionManager.Instance.EnsureInTransaction(doc)
    result = {}
    for i,x in enumerate(typeList):
        for j,y in enumerate(paramNames):
            x.SetParameterByName(y, symbolDatas[i][j+1])
        
        res = x.SetParameterByName("Type Comments", "for placing")
        result[str(symbolDatas[i][3])] = res
    TransactionManager.Instance.TransactionTaskDone()


def chk_missingType(_secObj):
    
    sectId = _secObj["sectId"]
    memberType = _secObj["memberType"]
    sectType = _secObj["sectType"].replace(" ", "")
    sectSize = _secObj["sectSize"]
    
    fmtObj = 0
    if len(_secObj["fmtObj"]) == 1:
        
        if sectType == "H":
            if memberType == "Column":
                fmtObj = ["need to create new column type"]
            else:
                fmtObj = ["need to create new Beam type"]
        else:
            if memberType == "Column":
                fmtObj = noMatchCol
            else:
                fmtObj = noMatchBeam
    else:
        fmtObj = _secObj["fmtObj"]
    

    
    res = {
        "sectId": sectId,
        "memberType": memberType,
        "sectType": sectType,
        "sectSize": sectSize,
        "fmtObj": fmtObj,
    }
    
    return res
    



result = map(chk_missingType, input)


# Assign your output to the OUT variable.
OUT = result
# ----------------------------------------
code_block_27 = CodeBlock { "fmtObj"; }
valueAtKey_3 = DesignScript.Builtin.Dictionary.ValueAtKey(dictionary=createFamily, key=code_block_27)
code_block_28 = CodeBlock { "fmtCode"; }
valueAtKey_4 = DesignScript.Builtin.Dictionary.ValueAtKey(dictionary=all_column_types, key=code_block_28)
python_script_2 = Python()  # CPython3; unwired: IN[0]
# ---------- python_script_2.python (37 lines) ----------
# Load the Python Standard and DesignScript Libraries
import sys
import clr
clr.AddReference('ProtoGeometry')
from Autodesk.DesignScript.Geometry import *

clr.AddReference('RevitAPI')
from Autodesk.Revit.DB import *
import Autodesk

clr.AddReference('RevitServices')
import RevitServices
from RevitServices.Persistence import DocumentManager
doc = DocumentManager.Instance.CurrentDBDocument
collector = FilteredElementCollector(doc)

clr.AddReference("RevitNodes")
import Revit
clr.ImportExtensions(Revit.Elements)
clr.ImportExtensions(Revit.GeometryConversion)

import RevitServices
from RevitServices.Persistence import DocumentManager
from RevitServices.Transactions import TransactionManager
doc = DocumentManager.Instance.CurrentDBDocument

# The inputs to this node will be stored as a list in the IN variables.
dataEnteringNode = IN

# Place your code below this line
allTypeObjOfCol = collector.OfCategory(BuiltInCategory.OST_StructuralColumns).WhereElementIsElementType().ToElements()

#tmp = map(lambda x: x.get_Name(), allTypeObjOfCol)

result = filter(lambda x: "noMatch" in x.get_Name(), allTypeObjOfCol)
# Assign your output to the OUT variable.
OUT = result
# ----------------------------------------
