# Dynamo graph WorkStamp_rA.dyn (Dynamo 2.16.1.2727)

workstamp_매개변수가_없습니까 = BoolSelector(false)  # graph input
code_block = CodeBlock { "WorkStamp"; "HEC_params"; []; }
if_ = RefactoredIf(test=workstamp_매개변수가_없습니까, true=code_block.out0, false=code_block.out2)
spec_types = SpecTypes("autodesk.spec:spec.string")
group_types = GroupTypes("autodesk.parameter.group:identityData")
boolean = BoolSelector(true)
createProjectParameterForAllCategories = Parameter.CreateProjectParameterForAllCategories(parameterName=if_, groupName=code_block.out1, specType=spec_types, groupType=group_types, instance=boolean)
작업_태그_부여 = StringInput("최신 작업 요약 설명(2 ~ 3 단어)")  # graph input
allElems = Python(IN[0]=code_block.out0)  # CPython3
# ---------- allElems.python (33 lines) ----------
# Load the Python Standard and DesignScript Libraries
import sys
import clr

clr.AddReference('RevitAPI')
from Autodesk.Revit.DB import *
import Autodesk

clr.AddReference('RevitNodes')
import Revit
clr.ImportExtensions(Revit.Elements)

clr.AddReference('RevitServices')
import RevitServices
from RevitServices.Persistence import DocumentManager
doc = DocumentManager.Instance.CurrentDBDocument
collector = FilteredElementCollector(doc)

clr.AddReference('ProtoGeometry')
from Autodesk.DesignScript.Geometry import *

# The inputs to this node will be stored as a list in the IN variables.
dataEnteringNode = IN
paramName = IN[0]

# Place your code below this line

allElems = collector.WhereElementIsNotElementType().ToElements()
##filtered_allElems = list(filter(lambda x: str(x)!="Autodesk.Revit.DB.View3D", allElems))

# Assign your output to the OUT variable.
##OUT = allElems
OUT = allElems
# ----------------------------------------
파리미터값_조회가능_객체_필터 = Python(IN[0]=allElems)  # CPython3; graph output
# ---------- 파리미터값_조회가능_객체_필터.python (25 lines) ----------
# Load the Python Standard and DesignScript Libraries
import sys
import clr
clr.AddReference('ProtoGeometry')
from Autodesk.DesignScript.Geometry import *

# The inputs to this node will be stored as a list in the IN variables.
dataEnteringNode = IN

allElems = IN[0]
# Place your code below this line

res = []
for i in allElems:
    try:
        i.GetParameterValueByName("WorkStamp")
        res.append(i)

    except:
        pass



# Assign your output to the OUT variable.
OUT = res
# ----------------------------------------
이미_값이_있는_객체_제외 = Python(IN[0]=파리미터값_조회가능_객체_필터)  # CPython3
# ---------- 이미_값이_있는_객체_제외.python (17 lines) ----------
# Load the Python Standard and DesignScript Libraries
import sys
import clr
clr.AddReference('ProtoGeometry')
from Autodesk.DesignScript.Geometry import *

# The inputs to this node will be stored as a list in the IN variables.
dataEnteringNode = IN

allElems = IN[0]

# Place your code below this line

res = filter(lambda x: x.GetParameterValueByName("WorkStamp") =="", allElems)

# Assign your output to the OUT variable.
OUT = res
# ----------------------------------------
파라미터값수정 = Python(IN[0]=작업_태그_부여, IN[1]=이미_값이_있는_객체_제외)  # CPython3
# ---------- 파라미터값수정.python (24 lines) ----------
# Load the Python Standard and DesignScript Libraries
import sys
import clr
clr.AddReference('ProtoGeometry')
from Autodesk.DesignScript.Geometry import *

# The inputs to this node will be stored as a list in the IN variables.
dataEnteringNode = IN
inStr = IN[0]
allElems = IN[1]
# Place your code below this line

res = []
for i in allElems:
    try:
        i.SetParameterByName("WorkStamp", inStr)
        res.append(i)
    except:
        pass



# Assign your output to the OUT variable.
OUT = res
# ----------------------------------------
