# Dynamo graph AllElementsofCatfromLinkedModel.dyn (Dynamo 2.16.1.2727)

element_classes = ElementTypes("RevitLinkInstance")
all_elements_of_class = ElementsOfType(element_class=element_classes)
parameters = Element.Parameters(element=all_elements_of_class)
python_script = Python()  # CPython3; unwired: IN[0]
# ---------- python_script.python (59 lines) ----------
# Load the Python Standard and DesignScript Libraries
import sys
import clr
clr.AddReference("ProtoGeometry")
from Autodesk.DesignScript.Geometry import *
## Import ToDSType(bool) extension method
clr.AddReference("RevitNodes")
import Revit
clr.ImportExtensions(Revit.Elements)
## Import geometry conversion extension methods
clr.ImportExtensions(Revit.GeometryConversion)
## Import DocumentManager and TransactionManager
clr.AddReference("RevitServices")
import RevitServices
from RevitServices.Persistence import DocumentManager
from RevitServices.Transactions import TransactionManager
from System.Collections.Generic import *

## Import RevitAPI
clr.AddReference("RevitAPI")
import Autodesk
from Autodesk.Revit.DB import *

#clr.AddReference("DSCoreNodes")
#import DSCore
#from DSCore.List import *

doc = DocumentManager.Instance.CurrentDBDocument
uiapp = DocumentManager.Instance.CurrentUIApplication
app = uiapp.Application
uidoc=DocumentManager.Instance.CurrentUIApplication.ActiveUIDocument

lnks = FilteredElementCollector(doc).OfClass(RevitLinkInstance)

# The inputs to this node will be stored as a list in the IN variables.
dataEnteringNode = IN

# Place your code below this line

#tmp = map(lambda x: x.GetLinkDocument(), lnks)

out = []

for i in lnks:
    doclnk = i.GetLinkDocument()
    coll = FilteredElementCollector(doclnk).OfCategory(BuiltInCategory.OST_StructuralColumns).WhereElementIsNotElementType().ToElements()

    out.append(coll)

## Start Transaction
TransactionManager.Instance.EnsureInTransaction(doc)

## End the Transaction
TransactionManager.Instance.TransactionTaskDone()

OUT = out

# Assign your output to the OUT variable.
OUT = out
# ----------------------------------------
geometry = Element.Geometry(element=python_script)
