# Dynamo graph linked element 불러오기.dyn (Dynamo 2.10.1.3976)

boolean = BoolSelector(true)
get_linked_element = Python(IN[0]=boolean)  # IronPython2
# ---------- get_linked_element.python (43 lines) ----------
import clr

clr.AddReference('RevitAPI')
from Autodesk.Revit.DB import *
from Autodesk.Revit.DB.Structure import *

clr.AddReference('RevitAPIUI')
from Autodesk.Revit.UI import *

clr.AddReference('System')
from System.Collections.Generic import List

clr.AddReference('RevitNodes')
import Revit
clr.ImportExtensions(Revit.GeometryConversion)
clr.ImportExtensions(Revit.Elements)

clr.AddReference('RevitServices')
import RevitServices
from RevitServices.Persistence import DocumentManager
from RevitServices.Transactions import TransactionManager

doc = DocumentManager.Instance.CurrentDBDocument
uidoc=DocumentManager.Instance.CurrentUIApplication.ActiveUIDocument

#Preparing input from dynamo to revit
if isinstance (IN[0], list):
	element = [UnwrapElement(e) for e in IN[0]]
else:
	element = [UnwrapElement(IN[0])]

#Do some action in a Transaction
outVal = []
tF = []
ref_list = uidoc.Selection.PickObjects(Selection.ObjectType.LinkedElement)
for ref in ref_list:
	docElement = doc.GetElement(ref)
	linkdoc = docElement.GetLinkDocument()
	ele = linkdoc.GetElement(ref.LinkedElementId)
	outVal.Add(ele)
	tF.Add(docElement.GetTotalTransform().ToCoordinateSystem())

OUT = outVal, tF
# ----------------------------------------
code_block = CodeBlock(out=get_linked_element) { out[0]; out[1]; }
code_block_2 = CodeBlock(mass=code_block.out0) { mass; }
geometry = Element.Geometry(element=code_block_2)
code_block_3 = CodeBlock(transform=code_block.out1) { transform; }
transform = Geometry.Transform(geometry=geometry, cs=code_block_3)
