# Dynamo graph UnionChecker.dyn (Dynamo 2.12.0.5650)

select_model_elements = DSModelElementsSelection()  # 24 picked in the model
geometry = Element.Geometry(element=select_model_elements)
flatten = List.Flatten(list=geometry)
byUnion = Solid.ByUnion(solids=flatten)
unionChecker = Python(IN[0]=flatten)  # IronPython2
# ---------- unionChecker.python (24 lines) ----------
# Load the Python Standard and DesignScript Libraries
import sys
import clr
clr.AddReference('ProtoGeometry')
from Autodesk.DesignScript.Geometry import *

# The inputs to this node will be stored as a list in the IN variables.
dataEnteringNode = IN

# Place your code below this line
solids=IN[0]
errorset=[]

for i in range(len(solids)):
	sol1=solids[i]
	for j in range(len(solids)):
		if j>i:
			sol2=solids[j]
			try:
				sol1.Union(sol2)
			except:
				errorset.append([i,j])
# Assign your output to the OUT variable.
OUT = errorset
# ----------------------------------------
getItemAtIndex = List.GetItemAtIndex(list=select_model_elements, index=unionChecker)
getItemAtIndex_2 = List.GetItemAtIndex(list=flatten, index=unionChecker)
