# Dynamo graph 4. import excel test.dyn (Dynamo 2.16.1.2727)

file_path = Filename("D:\OneDrive - Autodesk\50.DYN\91.Help John Rivas\230404 make schedule\excel.xlsx")
file_from_path = FileObject(path=file_path)
code_block = CodeBlock { ["Doors_IFC","Walls_IFC","Windows_IFC"]; }
code_block_2 = CodeBlock { false; }
importExcel = Data.ImportExcel(file=file_from_path, sheetName=code_block, readAsStrings=code_block_2, showExcel=code_block_2)
deconstruct = List.Deconstruct(list=importExcel@L3)
watch = Watch(deconstruct.first)
watch_2 = Watch(deconstruct.rest)
dictionary = Python(IN[0]=importExcel)  # CPython3
# ---------- dictionary.python (53 lines) ----------
import clr

clr.AddReference('RevitAPI')
from Autodesk.Revit.DB import *

clr.AddReference('RevitAPIUI')
from Autodesk.Revit.UI import *

clr.AddReference('System')
from System.Collections.Generic import List

clr.AddReference('RevitNodes')
import Revit
clr.ImportExtensions(Revit.GeometryConversion)
clr.ImportExtensions(Revit.Elements)

clr.AddReference('RevitServices')
from RevitServices.Persistence import DocumentManager
import RevitServices
from RevitServices.Transactions import TransactionManager


def Unwrap(item):
    result = []
    if isinstance (item, list):
        for i in item:
            result.append(Unwrap(i))
    else:
        result = UnwrapElement(item)
    return result


doc = DocumentManager.Instance.CurrentDBDocument
uidoc=DocumentManager.Instance.CurrentUIApplication.ActiveUIDocument

#Preparing input from dynamo to revit
if isinstance(IN[0], list):
    data = IN[0]
else:
    data = [IN[0]]
outVal = []
for subData in data:
    dicList = []
    keys = subData[0]
    valueSet = [d for i, d in enumerate(subData) if i != 0]
    for values in valueSet:
        dic = dict()
        for i, value in enumerate(values):
            dic[keys[i]] = value
        dicList.append(dic)      
    

OUT = dicList
# ----------------------------------------
python_script = Python(IN[0]=importExcel)  # CPython3
# ---------- python_script.python (121 lines) ----------
import clr

clr.AddReference('RevitAPI')
from Autodesk.Revit.DB import *

clr.AddReference('RevitAPIUI')
from Autodesk.Revit.UI import *

clr.AddReference('System')
from System.Collections.Generic import List

clr.AddReference('RevitNodes')
import Revit
clr.ImportExtensions(Revit.GeometryConversion)
clr.ImportExtensions(Revit.Elements)

clr.AddReference('RevitServices')
from RevitServices.Persistence import DocumentManager
import RevitServices
from RevitServices.Transactions import TransactionManager


def Unwrap(item):
    result = []
    if isinstance (item, list):
        for i in item:
            result.append(Unwrap(i))
    else:
        result = UnwrapElement(item)
    return result


doc = DocumentManager.Instance.CurrentDBDocument
uidoc=DocumentManager.Instance.CurrentUIApplication.ActiveUIDocument

#Preparing input from dynamo to revit
if isinstance(IN[0], list):
    data = IN[0]
else:
    data = [IN[0]]
outVal = []
TransactionManager.Instance.EnsureInTransaction(doc)


for subData in data:
    dicList = []
    keys = subData[0]
    valueSet = [d for i, d in enumerate(subData) if i != 0]
    for values in valueSet:
        dic = dict()
        for i, value in enumerate(values):
            dic[keys[i]] = value
        dicList.append(dic)
    ###
    for dic in dicList:
        element = doc.GetElement(ElementId(dic["ElementId"]))
        elementType = doc.GetElement(element.GetTypeId())
        parameters = []
        for key in keys:
            if key == "ElementId":
                continue
            parameter = element.LookupParameter(key)
            if parameter is None:
                parameter = elementType.LookupParameter(key)
            type = parameter.StorageType
            valueToChange = None
            valueExisting = None
            if type == StorageType.Double:
                valueToChange = float(dic[key])
                valueExisting = parameter.AsDouble()
            elif type == StorageType.Integer:
                if dic[key] == "No":
                    valueToChange = 0
                elif dic[key] == "Yes":
                    valueToChange = 1
                else:
                    valueToChange = int(dic[key])
                valueExisting = parameter.AsInteger()
            elif type == StorageType.String:
                if dic[key] == None:
                    valueToChange = None
                else:
                    valueToChange = str(dic[key])
                if parameter.AsString() == None:
                    valueExisting = None
                else:
                    valueExisting = parameter.AsString()
            elif type == StorageType.ElementId:
                valueToChange = (dic[key])
                valueExisting = parameter.AsElementId()
                
                
            outVal.append([key, valueToChange, valueExisting])
            
            if(valueToChange != valueExisting):
                #CheckIf dataType is Bool
                if parameter.Definition.GetDataType().TypeId == SpecTypeId.Boolean.YesNo.TypeId:
                    parameter.Set(valueToChange)
                    """
                    if valueToChange == "Yes" or valueToChange == "yes":
                        print("I'm here")
                        parameter.Set(1)
                    elif valueToChange == "No" or valueToChange == "no":
                        print("I'm there")
                        parameter.Set(0)
                    """
                elif type == StorageType.Double or type == StorageType.Integer:
                    convertVal = UnitUtils.ConvertToInternalUnits(valueToChange, parameter.GetUnitTypeId())
                    parameter.Set(convertVal)
                else:
                    parameter.Set(valueToChange)
                
            
 
        
        #outVal.append(element)
    
TransactionManager.Instance.TransactionTaskDone()    
    

OUT = outVal
# ----------------------------------------
