# Dynamo graph 211129_pipe distance.dyn (Dynamo 2.10.1.3976)

boolean = BoolSelector(false)
windows_form_dimension = Python(IN[0]=boolean)  # CPython3; unwired: IN[1]
# ---------- windows_form_dimension.python (188 lines) ----------
import clr

clr.AddReference('RevitAPI')
from Autodesk.Revit.DB import *
from Autodesk.Revit.DB.Structure import *

clr.AddReference('RevitAPIUI')
from Autodesk.Revit.UI import *

clr.AddReference('System')
from System.Collections.Generic import List

clr.AddReference('RevitNodes')
import Revit
clr.ImportExtensions(Revit.GeometryConversion)
clr.ImportExtensions(Revit.Elements)

clr.AddReference('RevitServices')
import RevitServices
from RevitServices.Persistence import DocumentManager
from RevitServices.Transactions import TransactionManager

clr.AddReference('System.Windows.Forms')
from System.Windows.Forms import *
clr.AddReference('System.Drawing')
from System.Drawing import *

clr.AddReference('DSCoreNodes')
from DSCore import Math


doc = DocumentManager.Instance.CurrentDBDocument
uidoc=DocumentManager.Instance.CurrentUIApplication.ActiveUIDocument

#Preparing input from dynamo to revit
if isinstance (IN[0], list):
	element = [UnwrapElement(e) for e in IN[0]]
else:
	element = [UnwrapElement(IN[0])]

#Do some action in a Transaction
TransactionManager.Instance.EnsureInTransaction(doc)

TransactionManager.Instance.TransactionTaskDone()

class CustomForm():
    def __init__(self):
    
        #class data
        self.data = 'foo'
        
        #form
        self.form = Form()
        self.form.ShowIcon = False
        self.form.MaximizeBox = False
        self.form.FormBorderStyle = FormBorderStyle.FixedSingle
        self.form.Size = Size(400,150)
        
        #label
        self.currDist_label = Label()
        self.currDist_label.Parent = self.form
        self.currDist_label.Location = Point(21,18)
        self.currDist_label.Size = Size(90,13)
        self.currDist_label.Text = 'Current Distance'
        
        self.tarDist_label = Label()
        self.tarDist_label.Parent = self.form
        self.tarDist_label.Location = Point(21,66)
        self.tarDist_label.Size = Size(90,13)
        self.tarDist_label.Text = 'Distance to Set'
        
        
        
        #TextBox
        self.currDist_textBox = TextBox()
        self.currDist_textBox.Location = Point(131,12)
        self.currDist_textBox.Size = Size(148,25)
        self.currDist_textBox.Text = 'test'
        self.currDist_textBox.ReadOnly = True
        self.currDist_textBox.Parent = self.form

        self.tarDist_textBox = TextBox()
        self.tarDist_textBox.Location = Point(131,60)
        self.tarDist_textBox.Size = Size(148,25)
        self.tarDist_textBox.Text = ''
        self.tarDist_textBox.Parent = self.form
        self.form.ActiveControl = self.tarDist_textBox
        #button
        
        self.button1 = Button()
        self.button1.Text = 'Confirm'
        self.button1.Name = 'Confirm'
        self.button1.Parent = self.form
        self.button1.Location = Point(297,12)
        self.button1.Size = Size(75,25)
        
        self.button2 = Button()
        self.button2.Text = 'Cancel'
        self.button2.Name = 'Cancel'
        self.button2.Parent = self.form
        self.button2.Location = Point(297,60)
        self.button2.Size = Size(75,25)
        
        #events
        
        self.form.Load += self.formLoadHandler
        self.button1.Click += self.buttonClickHandler
        self.button2.Click += self.buttonClickHandler        
        self.tarDist_textBox.KeyDown += self.keyPressHandler

    def Show(self):
        self.form.ShowDialog()
		
    def keyPressHandler(self, sender, args):
       #MessageBox.Show("key pressed"+args.KeyChar)
       if (args.KeyCode == Keys.Enter):
           self.buttonClickHandler(self.button1, args)
		
    def buttonClickHandler(self, sender, args):
        if(sender.Name == 'Cancel'):
            self.form.Close()
        if(sender.Name == 'Confirm'):
            self.data = self.tarDist_textBox.Text
            self.form.Close()

    def formLoadHandler(self, sender, args):
        sender.Text = 'Dynamo'
        
        
TransactionManager.Instance.EnsureInTransaction(doc)
view = doc.ActiveView
sel1 = uidoc.Selection.PickObject(Selection.ObjectType.Element)
sel2 = uidoc.Selection.PickObject(Selection.ObjectType.Element)
ele1 = doc.GetElement(sel1)
line1 = ele1.Location.Curve
pt1 = line1.Evaluate(0.5, True)
rot = Transform.CreateRotationAtPoint(XYZ(0,0,1), Math.PI/2, pt1)
line_trans = line1.CreateTransformed(rot)
vec1 = line_trans.Direction
ele2 = doc.GetElement(sel2)

ref_Array = ReferenceArray()
ref_Array.Append(sel1)
ref_Array.Append(sel2)

dim = doc.Create.NewDimension(view, line_trans, ref_Array)
val = dim.Value
convert_val = UnitUtils.ConvertFromInternalUnits(val, UnitTypeId.Millimeters)
TransactionManager.Instance.TransactionTaskDone()

cf = CustomForm()

cf.currDist_textBox.Text = str(Math.Round(convert_val,0))

cf.Show()

if cf.data == 'foo':
    OUT = 0

else:
    
    targetVal = float(cf.data)
    
    TransactionManager.Instance.EnsureInTransaction(doc)
    
    ele2 = doc.GetElement(sel1)
    calcVal = UnitUtils.ConvertToInternalUnits(targetVal - convert_val, UnitTypeId.Millimeters)
    normal_pt = vec1.Normalize()
    move_XYZ = normal_pt.Multiply(calcVal)
    
    ElementTransformUtils.MoveElement(doc, ele2.Id, move_XYZ)
    TransactionManager.Instance.TransactionTaskDone()
    
    
    translatedVal = dim.Value
    translatedVal_unit = UnitUtils.ConvertFromInternalUnits(translatedVal, UnitTypeId.Millimeters)
    
    
    if abs(translatedVal_unit - targetVal) > 0.005:
        TransactionManager.Instance.EnsureInTransaction(doc)
        reverse_XYZ = move_XYZ.Multiply(-2)
        ElementTransformUtils.MoveElement(doc, ele2.Id, reverse_XYZ)
        TransactionManager.Instance.TransactionTaskDone()
    
    #delete dimension
    doc.Delete(dim.Id)
    
    OUT = ele2
# ----------------------------------------
