# Dynamo graph RGB OVERRIDE.dyn (Dynamo 2.10.1.3976)

file_path = Filename("..\SYSTEM NAME RGB.xlsx")
file_from_path = FileObject(path=file_path)
string = StringInput("Hydronic Supply")
importExcel = Data.ImportExcel(file=file_from_path, sheetName=string)
transpose = List.Transpose(lists=importExcel)
restOfItems = List.RestOfItems(list=transpose)
code_block = CodeBlock { 0; 1; 2; }
getItemAtIndex = List.GetItemAtIndex(list=restOfItems, index=code_block.out0)
getItemAtIndex_2 = List.GetItemAtIndex(list=restOfItems, index=code_block.out1)
getItemAtIndex_3 = List.GetItemAtIndex(list=restOfItems, index=code_block.out2)
byARGB = Color.ByARGB(r=getItemAtIndex, g=getItemAtIndex_2, b=getItemAtIndex_3)
overrideColorInView = Element.OverrideColorInView(color=byARGB)  # unwired: element
firstItem = List.FirstItem(list=transpose)
categories = Categories("OST_PipingSystem")
all_elements_of_category = ElementsOfCategory(Category=categories)
name = Element.Name(element=all_elements_of_category)
code_block_2 = CodeBlock { " "; }
split = String.Split(str=name, separator0=code_block_2)
code_block_3 = CodeBlock { 0; }
getItemAtIndex_4 = List.GetItemAtIndex(list=split@L2, index=code_block_3)
uniqueItems = List.UniqueItems(list=getItemAtIndex_4)
sort = List.Sort(list=uniqueItems)
