# Dynamo graph ElementsJoinManager(20220408).dyn (Dynamo 2.12.0.5650)

# group: 기초 기둥 결합기
code_block = CodeBlock {  }

join = List.Join()  # unwired: list0, list1
categories = Categories("OST_StructuralFoundation")
all_elements_of_category = ElementsOfCategory(Category=categories)
categories_2 = Categories("OST_StructuralColumns")
all_elements_of_category_2 = ElementsOfCategory(Category=categories_2)
geometry = Element.Geometry(element=all_elements_of_category)
flatten = List.Flatten(list=geometry)
geometry_2 = Element.Geometry(element=all_elements_of_category_2)
flatten_2 = List.Flatten(list=geometry_2)
doesIntersect = Geometry.DoesIntersect(geometry=flatten@L1, other=flatten_2)
filterByBoolMask = List.FilterByBoolMask(list=all_elements_of_category_2, mask=doesIntersect@L2)
laceShortest = List.LaceShortest(combineFunction=join, list0=all_elements_of_category, list1=filterByBoolMask.in)
count = List.Count(list=laceShortest@L2)
code_block_2 = CodeBlock(i=count) { i == 1; }
filterByBoolMask_2 = List.FilterByBoolMask(list=laceShortest, mask=code_block_2)
firstItem = List.FirstItem(list=filterByBoolMask_2.out@L2)
lastItem = List.LastItem(list=filterByBoolMask_2.out@L2)
joinGeometry = Element.JoinGeometry(element=firstItem, otherElement=lastItem, lacing=Shortest)
