# Dynamo graph 실전테스트.dyn (Dynamo 2.12.0.5650)

python_script = Python()  # CPython3; unwired: IN[0]
# ---------- python_script.python (68 lines) ----------
# Load the Python Standard and DesignScript Libraries
import sys
import clr
clr.AddReference('ProtoGeometry')
from Autodesk.DesignScript.Geometry import *

from functools import reduce

# The inputs to this node will be stored as a list in the IN variables.
dataEnteringNode = IN

# Place your code below this line

###################################################################################################
curry = lambda f: lambda a,*args: f(a, *args) if (len(args)) else lambda *args: f(a, *args)

add = curry(lambda a,b: a + b)

filter = curry(filter)
map = curry(map)

def _take(length, iter):
    res = []
    for a in iter:
        res.append(a)
        if len(res) == length:
            return res
take = curry(_take)
reduce = curry(reduce)

go = lambda *args: reduce(lambda a,f: f(a), args) ## 함수도 축약 가능 ##
###################################################################################################



f = lambda list, length: reduce(add,
            take(length,
                map(lambda a: a * a,
                    filter(lambda a: a%2, list))))

f2 = lambda list, length: go( list,
    lambda list: filter(lambda a: a % 2, list),
    lambda list: map(lambda a: a * a, list),
    lambda list: take(length, list),
    lambda list: reduce(add, list)
    )

f3 = lambda list, length: go( list,
        filter(lambda a: a % 2),
        map(lambda a: a * a),
        take(length),
        reduce(add))
    
f4 = lambda list: go( list,
        filter(lambda a: a % 2),
        map(lambda a: a * a),
        reduce(add))
    
f5 = lambda list: go( list,
        filter(lambda a: not a % 2),
        filter(lambda a: not a % 4),
        map(lambda a: a * a),
        reduce(add))

result = f5([1,2,3,4,5,6,7,8])

# Assign your output to the OUT variable.
OUT = result
# ----------------------------------------
categories = Categories("OST_StructuralFoundation")
all_elements_of_category = ElementsOfCategory(Category=categories)
func = Python(IN[0]=all_elements_of_category)  # CPython3
# ---------- func.python (111 lines) ----------
# Load the Python Standard and DesignScript Libraries
import sys
import clr
clr.AddReference('ProtoGeometry')
from Autodesk.DesignScript.Geometry import *

from functools import reduce
from itertools import chain

# The inputs to this node will be stored as a list in the IN variables.
dataEnteringNode = IN

allElems = IN[0]
# Place your code below this line

###################################################################################################
curry = lambda f: lambda a,*args: f(a, *args) if (len(args)) else lambda *args: f(a, *args)

add = curry(lambda a,b: a + b)

filter = curry(filter)
map = curry(map)

def _take(length, iter):
    res = []
    for a in iter:
        res.append(a)
        if len(res) == length:
            return res
take = curry(_take)
reduce = curry(reduce)

go = lambda *args: reduce(lambda a,f: f(a), args) ## 함수도 축약 가능 ##
###########################################

    
Qfunc_len = lambda list, length: go( list,
        filter(lambda a: a % 2),
        map(lambda a: a * a),
        take(length),
        reduce(add))
    
Qfunc = lambda list: go( list,
        filter(lambda a: not a % 2),
        filter(lambda a: not a % 4),
        map(lambda a: a * a),
        reduce(add))

###################################################################################################


def 측면추출기(geo):
    list = geo.Explode()
    res = lambda list: go( list,
        filter(lambda a: round(a.NormalAtParameter(0.5,0.5).Z, 3) == 0),
        map(lambda a: a)
        )
    return res(list)

def 터파기형상생성기(geo, 경사율=2, 하부간격=300, 버림두께=50):
    def 터파기깊이계산기(list):
        res = lambda list: go( list,
        map(lambda a: a.StartPoint.Z)
        )
        return min(res(list))
        
    def 터파기밑테두리들생성기(geo, 하부간격):
        list = geo.Explode() ## surface들
        res = lambda list: go( list,
        filter(lambda a: round(a.NormalAtParameter(0.5,0.5).Z, 3) == -1),
        map(lambda a: a.PerimeterCurves())
        )
        return res(list)
        
    def 터파기윗테두리생성기(밑테두리, 깊이, 경사율):
        윗테두리들 = 밑테두리.Translate(0,0,-깊이)
        윗테두리 = 윗테두리들.Offset(-깊이/경사율)
        return  윗테두리
        
    def 형상생성기(밑테두리, 윗테두리):
        pass
    
    밑테두리들 = list(chain(*터파기밑테두리들생성기(geo, 하부간격)))
    깊이 = 터파기깊이계산기(밑테두리들)
    밑테두리 = PolyCurve.ByJoinedCurves(밑테두리들)
    윗테두리 = 터파기윗테두리생성기(밑테두리, 깊이, 경사율)
    터파기형상 = Solid.ByLoft([밑테두리.Offset(하부간격), 윗테두리])
    
    return 터파기형상

필터객체형상추출기 = lambda list: go( list,
        filter(lambda a: "Footing-" in a.Name),
        map(lambda a: a.Geometry()[0])
        )

필터객체측면추출기 = lambda list: go( list,
        filter(lambda a: "Footing-" in a.Name),
        map(lambda a: [a,측면추출기(a.Geometry()[0])])
        )


필터객체터파기생성기 = lambda list: go( list,
        filter(lambda a: "Footing-" in a.Name),
        map(lambda a: 터파기형상생성기(a.Geometry()[0]))
        )

#result = Qfunc([1,2,3,4,5,6,7,8])
result = 필터객체터파기생성기(allElems)

# Assign your output to the OUT variable.
OUT = result
# ----------------------------------------
python_script_2 = Python(IN[0]=all_elements_of_category)  # CPython3
# ---------- python_script_2.python (13 lines) ----------
# Load the Python Standard and DesignScript Libraries
import sys
import clr
clr.AddReference('ProtoGeometry')
from Autodesk.DesignScript.Geometry import *

# The inputs to this node will be stored as a list in the IN variables.
dataEnteringNode = IN
els = IN[0]
# Place your code below this line
result = type(IN[0])
# Assign your output to the OUT variable.
OUT = result
# ----------------------------------------
byLoft = Solid.ByLoft()  # unwired: crossSections
curves = PolyCurve.Curves()  # unwired: polyCurve
func_2 = Python(IN[0]=all_elements_of_category)  # CPython3
# ---------- func_2.python (127 lines) ----------
# Load the Python Standard and DesignScript Libraries
import sys
import clr

clr.AddReference('RevitAPI')
from Autodesk.Revit.DB import *
import Autodesk

clr.AddReference('RevitNodes')
import Revit
clr.ImportExtensions(Revit.Elements)

clr.AddReference('RevitServices')
import RevitServices
from RevitServices.Persistence import DocumentManager
doc = DocumentManager.Instance.CurrentDBDocument
collector1 = FilteredElementCollector(doc)

clr.AddReference('ProtoGeometry')
from Autodesk.DesignScript.Geometry import *

from functools import reduce
from itertools import chain

allFdns = collector1.OfCategory(BuiltInCategory.OST_StructuralFoundation).WhereElementIsNotElementType().ToElements()
# The inputs to this node will be stored as a list in the IN variables.
dataEnteringNode = IN

allElems = IN[0]
# Place your code below this line

###################################################################################################
curry = lambda f: lambda a,*args: f(a, *args) if (len(args)) else lambda *args: f(a, *args)

add = curry(lambda a,b: a + b)

filter = curry(filter)
map = curry(map)

def _take(length, iter):
    res = []
    for a in iter:
        res.append(a)
        if len(res) == length:
            return res
take = curry(_take)
reduce = curry(reduce)

go = lambda *args: reduce(lambda a,f: f(a), args) ## 함수도 축약 가능 ##
###########################################

    
Qfunc_len = lambda list, length: go( list,
        filter(lambda a: a % 2),
        map(lambda a: a * a),
        take(length),
        reduce(add))
    
Qfunc = lambda list: go( list,
        filter(lambda a: not a % 2),
        filter(lambda a: not a % 4),
        map(lambda a: a * a),
        reduce(add))

###################################################################################################


def 측면추출기(geo):
    list = geo.Explode()
    res = lambda list: go( list,
        filter(lambda a: round(a.NormalAtParameter(0.5,0.5).Z, 3) == 0),
        map(lambda a: a)
        )
    return res(list)

def 터파기형상생성기(geo, 경사율=2, 하부간격=300, 버림두께=50):
    def 터파기깊이계산기(list):
        res = lambda list: go( list,
        map(lambda a: a.StartPoint.Z)
        )
        return min(res(list))
        
    def 터파기테두리들생성기(geo, 하부간격):
        list = geo.Explode() ## surface들
        res = lambda list: go( list,
        filter(lambda a: round(a.NormalAtParameter(0.5,0.5).Z, 3) == -1),
        map(lambda a: a.PerimeterCurves())
        )
        return res(list)
        
    def 터파기윗테두리생성기(밑테두리, 깊이, 경사율):
        윗테두리들 = 밑테두리.Translate(0,0,-깊이)
        윗테두리 = 윗테두리들.Offset(-깊이/경사율)
        return  윗테두리
        
    def 형상생성기(밑테두리, 윗테두리):
        pass
    
    밑테두리들 = list(chain(*터파기밑테두리들생성기(geo, 하부간격)))
    깊이 = 터파기깊이계산기(밑테두리들)
    밑테두리 = PolyCurve.ByJoinedCurves(밑테두리들)
    윗테두리 = 터파기윗테두리생성기(밑테두리, 깊이, 경사율)
    터파기형상 = Solid.ByLoft([밑테두리.Offset(하부간격), 윗테두리])
    
    return 터파기형상

필터객체형상추출기 = lambda list: go( list,
        filter(lambda a: "Footing-" in a.Name),
        map(lambda a: a.Geometry()[0])
        )

필터객체측면추출기 = lambda list: go( list,
        filter(lambda a: "Footing-" in a.Name),
        map(lambda a: [a,측면추출기(a.Geometry()[0])])
        )


필터객체터파기생성기 = lambda list: go( list,
        filter(lambda a: "Footing-" in a.Name),
        map(lambda a: 터파기형상생성기(a.Geometry()[0]))
        )

#result = Qfunc([1,2,3,4,5,6,7,8])
result = 필터객체터파기생성기(allElems)

# Assign your output to the OUT variable.
OUT = result
# ----------------------------------------
