# Dynamo graph Qgridmaker_rC.dyn (Dynamo 2.10.1.3976)

# group: Qgridmaker
X축방향배열간격 = DoubleInput(6000)  # graph input
Y축방향배열간격 = DoubleInput(6000)  # graph input
x축배열_갯수 = DoubleSlider(10, range=0..100 step 1)  # graph input
y축배열_갯수 = DoubleSlider(17, range=0..100 step 1)  # graph input
퀵_그리드_메이커_input = CodeBlock(X배열간격=X축방향배열간격, Y배열간격=Y축방향배열간격, x축배열갯수=x축배열_갯수, y축배열갯수=y축배열_갯수)
# ---------- 퀵_그리드_메이커_input.designscript (5 lines) ----------
//그리드길이;
X배열간격;
Y배열간격;
x축배열갯수;
y축배열갯수;
# ----------------------------------------
퀵_그리드_메이커 = Python(IN[0]=퀵_그리드_메이커_input.X배열간격, IN[1]=퀵_그리드_메이커_input.Y배열간격, IN[2]=퀵_그리드_메이커_input.x축배열갯수, IN[3]=퀵_그리드_메이커_input.y축배열갯수)  # CPython3
# ---------- 퀵_그리드_메이커.python (88 lines) ----------
# Load the Python Standard and DesignScript Libraries
import sys
import clr
clr.AddReference('RevitAPI')
import Autodesk

clr.AddReference('ProtoGeometry')
from Autodesk.DesignScript.Geometry import *

clr.AddReference('RevitNodes')
import Revit
clr.ImportExtensions(Revit.Elements)

clr.ImportExtensions(Revit.GeometryConversion)
clr.ImportExtensions(Revit.GeometryReferences)

clr.AddReference('RevitServices')
import RevitServices
from RevitServices.Persistence import DocumentManager
from RevitServices.Transactions import TransactionManager

doc = DocumentManager.Instance.CurrentDBDocument

############################################################
############### Function Import part - start ###############
def repeatFuncApply(func, repeat, data_input):
    result = []
    input_forFunc = data_input
    while repeat != 0:
        result.append(func(input_forFunc))
        input_forFunc = func(input_forFunc)
        repeat = repeat - 1
    return result

def create_horizonLine(sttpt, endpt):
    #sttpt = Point.ByCoordinates(0,0,0)
    line_prime = Line.ByStartPointEndPoint(sttpt, endpt)
    return line_prime
    
def create_verticalLine(sttpt, endpt):
    #sttpt = Point.ByCoordinates(0,0,0)
    line_prime = Line.ByStartPointEndPoint(sttpt, endpt)
    return line_prime
    
def curveOffset(elem, dist):
    result = Curve.Offset(elem, dist)
    return result
############### Function Import part - end #################
############################################################

# The inputs to this node will be stored as a list in the IN variables.
dataEnteringNode = IN

#gridlength = IN[0]
dist_X = IN[0]
dist_Y = IN[1]
repeat_X = IN[2]
repeat_Y = IN[3]

basept = Revit.Elements.Coordinates.BasePoint()

# Place your code below this line
gridlength_X = dist_X * (repeat_X + 1)
gridlength_Y = dist_Y * (repeat_Y + 1)

sttptX = Geometry.Translate(basept, -dist_Y,dist_X,0)
sttptY = Geometry.Translate(basept, -dist_Y,dist_X,0)
endptX = Geometry.Translate(basept, -dist_Y+gridlength_Y,dist_X,0)
endptY = Geometry.Translate(basept, -dist_Y,dist_X-gridlength_X,0)

line_primeX = create_horizonLine(sttptX, endptX)
line_primeY = create_verticalLine(sttptY, endptY)

lineforX = repeatFuncApply(lambda i: curveOffset(i, dist_X), repeat_X, line_primeX)
lineforY = repeatFuncApply(lambda i: curveOffset(i, -dist_Y), repeat_Y, line_primeY)

grid_X = list(map(lambda i: i.ToRevitType(), lineforX))
grid_Y = list(map(lambda i: i.ToRevitType(), lineforY))
grid = grid_X + grid_Y

TransactionManager.Instance.EnsureInTransaction(doc)
gridAll = list(map(lambda i: Autodesk.Revit.DB.Grid.Create(doc, i), grid))
TransactionManager.Instance.TransactionTaskDone()

result = gridAll

# Assign your output to the OUT variable.
OUT = result
# ----------------------------------------

# group: 그리드 임시 네이밍(임시-중복명칭 해결용)
code_block = CodeBlock(input=퀵_그리드_메이커) { input; }
code_block_2 = CodeBlock { "Name"; }
count = List.Count(list=code_block)
code_block_3 = CodeBlock(i=count) { 100..100+i; }
string_from_object = FromObject(object=code_block_3)
setParameterByName = Element.SetParameterByName(element=code_block, parameterName=code_block_2, value=string_from_object)

# group: Grid 축방향 분류
code_block_4 = CodeBlock(input_GridforRetreatment=setParameterByName) { input_GridforRetreatment; }
curve = Grid.Curve(grid=code_block_4)
direction = Line.Direction(line=curve)
normalized = Vector.Normalized(vector=direction)
uniqueItems = List.UniqueItems(list=normalized)
code_block_5 = CodeBlock(i=uniqueItems) { i[0]; }
isParallel = Vector.IsParallel(vector=code_block_5, other=normalized)
filterByBoolMask = List.FilterByBoolMask(list=code_block_4, mask=isParallel)

# group: X축 진행 그리드네이밍-알파벳
code_block_6 = CodeBlock(input=filterByBoolMask.in) { input; }
code_block_7 = CodeBlock { "Name"; }
code_block_8 = CodeBlock { "A".."Z"; }
count_2 = List.Count(list=code_block_6)
code_block_9 = CodeBlock(i=count_2) { 0..i-1; }
getItemAtIndex = List.GetItemAtIndex(list=code_block_8, index=code_block_9)
setParameterByName_2 = Element.SetParameterByName(element=code_block_6, parameterName=code_block_7, value=getItemAtIndex)

# group: Y축 진행 그리드네이밍-숫자
code_block_10 = CodeBlock(input=filterByBoolMask.out) { input; }
code_block_11 = CodeBlock { "Name"; }
count_3 = List.Count(list=code_block_10)
code_block_12 = CodeBlock(i=count_3) { 1..i; }
string_from_object_2 = FromObject(object=code_block_12)
setParameterByName_3 = Element.SetParameterByName(element=code_block_10, parameterName=code_block_11, value=string_from_object_2)
