# Dynamo graph Qgridmaker.dyn (Dynamo 2.10.1.3976)

함수_라이브러리_함수_임포트_용 = Python()  # CPython3; unwired: IN[0]
# ---------- 함수_라이브러리_함수_임포트_용.python (67 lines) ----------
# Load the Python Standard and DesignScript Libraries
import sys
import clr
clr.AddReference('RevitAPI')
import Autodesk

clr.AddReference('ProtoGeometry')
from Autodesk.DesignScript.Geometry import *

clr.AddReference('RevitNodes')
import Revit
clr.ImportExtensions(Revit.Elements)

clr.ImportExtensions(Revit.GeometryConversion)
clr.ImportExtensions(Revit.GeometryReferences)

clr.AddReference('RevitServices')
import RevitServices
from RevitServices.Persistence import DocumentManager
from RevitServices.Transactions import TransactionManager

doc = DocumentManager.Instance.CurrentDBDocument

# The inputs to this node will be stored as a list in the IN variables.
dataEnteringNode = IN

# Place your code below this line
def repeatFuncApply(func, repeat, data_input):
    result = []
    input_forFunc = data_input
    while repeat != 0:
        result.append(func(input_forFunc))
        input_forFunc = func(input_forFunc)
        repeat = repeat - 1
    return result

def create_horizonLine(endpt):
    sttpt = Point.ByCoordinates(0,0,0)
    line_prime = Line.ByStartPointEndPoint(sttpt, endpt)
    return line_prime
    
def create_verticalLine(endpt):
    sttpt = Point.ByCoordinates(0,0,0)
    line_prime = Line.ByStartPointEndPoint(sttpt, endpt)
    return line_prime
    
def curveOffset(elem, dist):
    result = Curve.Offset(elem, dist)
    return result
    
def multiply_mk(a,b):
    return a * b





##########################################################
result = [
repeatFuncApply,
create_horizonLine,
create_verticalLine,
curveOffset,
multiply_mk
]	
# Assign your output to the OUT variable.
OUT = result
# ----------------------------------------
그리드길이 = DoubleInput(50000)  # graph input
그리드간격 = DoubleInput(6000)  # graph input
x축그리드갯수 = IntegerSlider(5, range=0..100 step 1)  # graph input
y축그리드갯수 = IntegerSlider(5, range=0..100 step 1)  # graph input
퀵_그리드_메이커_input = CodeBlock(그리드길이=그리드길이, 그리드간격=그리드간격, x축그리드갯수=x축그리드갯수, y축그리드갯수=y축그리드갯수) { 그리드길이; 그리드간격; x축그리드갯수; y축그리드갯수; }
퀵_그리드_메이커 = Python(IN[0]=함수_라이브러리_함수_임포트_용, IN[1]=퀵_그리드_메이커_input.그리드길이, IN[2]=퀵_그리드_메이커_input.그리드간격, IN[3]=퀵_그리드_메이커_input.x축그리드갯수, IN[4]=퀵_그리드_메이커_input.y축그리드갯수)  # CPython3
# ---------- 퀵_그리드_메이커.python (61 lines) ----------
# Load the Python Standard and DesignScript Libraries
import sys
import clr
clr.AddReference('RevitAPI')
import Autodesk

clr.AddReference('ProtoGeometry')
from Autodesk.DesignScript.Geometry import *

clr.AddReference('RevitNodes')
import Revit
clr.ImportExtensions(Revit.Elements)

clr.ImportExtensions(Revit.GeometryConversion)
clr.ImportExtensions(Revit.GeometryReferences)

clr.AddReference('RevitServices')
import RevitServices
from RevitServices.Persistence import DocumentManager
from RevitServices.Transactions import TransactionManager

doc = DocumentManager.Instance.CurrentDBDocument

############################################################
############### Function Import part - start ###############
repeatFuncApply = IN[0][0]
create_horizonLine = IN[0][1]
create_verticalLine = IN[0][2]
curveOffset = IN[0][3]
multi = IN[0][4]
############### Function Import part - end #################
############################################################

# The inputs to this node will be stored as a list in the IN variables.
dataEnteringNode = IN

gridlength = IN[1]
dist = IN[2]
repeat_X = IN[3]
repeat_Y = IN[4]
# Place your code below this line
endptX = Point.ByCoordinates(0,gridlength,0)
endptY = Point.ByCoordinates(gridlength,0,0)

line_primeX = create_horizonLine(endptX)
line_primeY = create_verticalLine(endptY)

lineforX = repeatFuncApply(lambda x: curveOffset(x, dist), repeat_X, line_primeX)
lineforY = repeatFuncApply(lambda x: curveOffset(x, -dist), repeat_Y, line_primeY)

grid_X = list(map(lambda x: x.ToRevitType(), lineforX))
grid_Y = list(map(lambda x: x.ToRevitType(), lineforY))
grid = grid_X + grid_Y

TransactionManager.Instance.EnsureInTransaction(doc)
gridAll = list(map(lambda x: Autodesk.Revit.DB.Grid.Create(doc, x), grid))
TransactionManager.Instance.TransactionTaskDone()
#result = [line_primeX, line_primeY]
result = gridAll
# Assign your output to the OUT variable.
OUT = result
# ----------------------------------------
