# Dynamo graph RandomPlacing.dyn (Dynamo 2.10.1.3976)

code_block = CodeBlock { 0..999..10; }
code_block_2 = CodeBlock { 2; -999; 999; }
code_block_3 = CodeBlock { 2; }
number_slider = DoubleSlider(81128.7, range=0..99999 step 0.1)  # graph input
randomList = Math.RandomList(amount=code_block_3, value1=code_block_2.out1, value2=code_block_2.out2, seed=number_slider)
randomList_2 = Math.RandomList(amount=code_block_2.out0, value1=code_block_2.out1, value2=code_block_2.out2, seed=randomList)
code_block_4 = CodeBlock { 0; }
getItemAtIndex = List.GetItemAtIndex(list=randomList_2@L2, index=code_block_4)
code_block_5 = CodeBlock { 1; }
getItemAtIndex_2 = List.GetItemAtIndex(list=randomList_2@L2, index=code_block_5)
byCoordinates = Point.ByCoordinates(x=getItemAtIndex, y=getItemAtIndex_2)
code_block_6 = CodeBlock { 200; }
byLengths = Cuboid.ByLengths(origin=byCoordinates, width=code_block_6, length=code_block_6, height=code_block_6)
centroid = Solid.Centroid(solid=byLengths)
python_script_convex_hull_graham = Python(IN[0]=byCoordinates)  # CPython3; frozen
# ---------- python_script_convex_hull_graham.python (57 lines) ----------
import clr
clr.AddReference('ProtoGeometry')
from Autodesk.DesignScript.Geometry import *

from functools import reduce

def ToVals(pt):
	return [pt.X,pt.Y,pt.Z]

def ToPts(ptVals):
	return Point.ByCoordinates(ptVals[0],ptVals[1],ptVals[2])

def CreateOutline(pts):
	crvs = []
	i = 0
	while i < len(pts):
		if i == len(pts)-1:
			crvs.append(Line.ByStartPointEndPoint(pts[i],pts[0]))
		else:
			crvs.append(Line.ByStartPointEndPoint(pts[i],pts[i+1]))
		i = i+1
	return PolyCurve.ByJoinedCurves(crvs)

'''
Taken from Thomas Switzers awesome GitHub repo and modified to suit Dynamo Context
https://gist.github.com/arthur-e/5cf52962341310f438e96c1f3c3398b8
I take zero credit for this work other than porting it across.
'''
def convex_hull_graham(points):
	'''
	Returns points on convex hull in CCW order according to Graham's scan algorithm. 
	By Tom Switzer <thomas.switzer@gmail.com>.
	'''
	TURN_LEFT, TURN_RIGHT, TURN_NONE = (1, -1, 0)

	def cmp(a, b):
		return (a > b) - (a < b)
	
	def turn(p, q, r):
		return cmp((q[0] - p[0])*(r[1] - p[1]) - (r[0] - p[0])*(q[1] - p[1]), 0)
	
	def _keep_left(hull, r):
		while len(hull) > 1 and turn(hull[-2], hull[-1], r) != TURN_LEFT:
			hull.pop()
		if not len(hull) or hull[-1] != r:
			hull.append(r)
		return hull

	points = [ToVals(p) for p in points]	
	points = sorted(points)
	l = reduce(_keep_left, points, [])
	u = reduce(_keep_left, reversed(points), [])
	points = l.extend(u[i] for i in range(1, len(u) - 1)) or l
	points = [ToPts(p) for p in points]
	return CreateOutline(points)

OUT = convex_hull_graham(IN[0])
# ----------------------------------------
byPatch = Surface.ByPatch(closedCurve=python_script_convex_hull_graham)
code_block_7 = CodeBlock { 0.5; }
pointAtParameter = Surface.PointAtParameter(surface=byPatch, u=code_block_7, v=code_block_7)
byStartPointEndPoint = Line.ByStartPointEndPoint(startPoint=pointAtParameter, endPoint=byCoordinates)
startPoint = Curve.StartPoint(curve=byStartPointEndPoint)
number_slider_2 = DoubleSlider(1.61, range=0.01..4 step 0.01)
pointAtParameter_2 = Curve.PointAtParameter(curve=byStartPointEndPoint, param=number_slider_2)
byStartPointEndPoint_2 = Line.ByStartPointEndPoint(startPoint=startPoint, endPoint=pointAtParameter_2)
endPoint = Curve.EndPoint(curve=byStartPointEndPoint_2)
code_block_8 = CodeBlock { 200; }
byLengths_2 = Cuboid.ByLengths(origin=endPoint, width=code_block_8, length=code_block_8, height=code_block_8)
centroid_2 = Solid.Centroid(solid=byLengths_2)
python_script_convex_hull_graham_2 = Python(IN[0]=centroid_2)  # CPython3; same code as python_script_convex_hull_graham
byPatch_2 = Surface.ByPatch(closedCurve=python_script_convex_hull_graham_2)
code_block_9 = CodeBlock { 0.5; }
pointAtParameter_3 = Surface.PointAtParameter(surface=byPatch_2, u=code_block_9, v=code_block_9)
code_block_10 = CodeBlock { 100; }
byCenterPointRadius = Circle.ByCenterPointRadius(centerPoint=byCoordinates, radius=code_block_10)
centerPoint = Circle.CenterPoint(circle=byCenterPointRadius)
byPoints = PolyCurve.ByPoints(points=centerPoint)
endPoint_2 = Curve.EndPoint(curve=byPoints)
startPoint_2 = Curve.StartPoint(curve=byPoints)
number_slider_3 = DoubleSlider(0.38, range=0.01..1 step 0.01)
pointAtParameter_4 = Curve.PointAtParameter(curve=byPoints, param=number_slider_3)
join = List.Join(list0=startPoint_2, list1=pointAtParameter_4)
code_block_11 = CodeBlock { [200,300]; }
code_block_12 = CodeBlock { 200; }
byLengths_3 = Cuboid.ByLengths(origin=join, width=code_block_11, length=code_block_11, height=code_block_12)
