# Dynamo graph RandomPlacing3.dyn (Dynamo 2.10.1.3976)

python_script_convex_hull_graham = Python()  # CPython3; frozen; unwired: IN[0]
# ---------- python_script_convex_hull_graham.python (57 lines) ----------
import clr
clr.AddReference('ProtoGeometry')
from Autodesk.DesignScript.Geometry import *

from functools import reduce

def ToVals(pt):
	return [pt.X,pt.Y,pt.Z]

def ToPts(ptVals):
	return Point.ByCoordinates(ptVals[0],ptVals[1],ptVals[2])

def CreateOutline(pts):
	crvs = []
	i = 0
	while i < len(pts):
		if i == len(pts)-1:
			crvs.append(Line.ByStartPointEndPoint(pts[i],pts[0]))
		else:
			crvs.append(Line.ByStartPointEndPoint(pts[i],pts[i+1]))
		i = i+1
	return PolyCurve.ByJoinedCurves(crvs)

'''
Taken from Thomas Switzers awesome GitHub repo and modified to suit Dynamo Context
https://gist.github.com/arthur-e/5cf52962341310f438e96c1f3c3398b8
I take zero credit for this work other than porting it across.
'''
def convex_hull_graham(points):
	'''
	Returns points on convex hull in CCW order according to Graham's scan algorithm. 
	By Tom Switzer <thomas.switzer@gmail.com>.
	'''
	TURN_LEFT, TURN_RIGHT, TURN_NONE = (1, -1, 0)

	def cmp(a, b):
		return (a > b) - (a < b)
	
	def turn(p, q, r):
		return cmp((q[0] - p[0])*(r[1] - p[1]) - (r[0] - p[0])*(q[1] - p[1]), 0)
	
	def _keep_left(hull, r):
		while len(hull) > 1 and turn(hull[-2], hull[-1], r) != TURN_LEFT:
			hull.pop()
		if not len(hull) or hull[-1] != r:
			hull.append(r)
		return hull

	points = [ToVals(p) for p in points]	
	points = sorted(points)
	l = reduce(_keep_left, points, [])
	u = reduce(_keep_left, reversed(points), [])
	points = l.extend(u[i] for i in range(1, len(u) - 1)) or l
	points = [ToPts(p) for p in points]
	return CreateOutline(points)

OUT = convex_hull_graham(IN[0])
# ----------------------------------------
code_block = CodeBlock { 0..999..10; }
code_block_2 = CodeBlock { 2; -999; 999; }
code_block_3 = CodeBlock { 2; }
number_slider = DoubleSlider(87280.2, range=0..99999 step 0.1)  # graph input
randomList = Math.RandomList(amount=code_block_3, value1=code_block_2.out1, value2=code_block_2.out2, seed=number_slider)
randomList_2 = Math.RandomList(amount=code_block_2.out0, value1=code_block_2.out1, value2=code_block_2.out2, seed=randomList)
code_block_4 = CodeBlock { 0; }
getItemAtIndex = List.GetItemAtIndex(list=randomList_2@L2, index=code_block_4)
code_block_5 = CodeBlock { 1; }
getItemAtIndex_2 = List.GetItemAtIndex(list=randomList_2@L2, index=code_block_5)
byCoordinates = Point.ByCoordinates(x=getItemAtIndex, y=getItemAtIndex_2)
code_block_6 = CodeBlock { 200; }
byLengths = Cuboid.ByLengths(origin=byCoordinates, width=code_block_6, length=code_block_6, height=code_block_6)

# group: premitive Box - Effective Curve
code_block_7 = CodeBlock(Input=byLengths) { _Input; }

firstItem = List.FirstItem(list=code_block_7)
lastItem = List.LastItem(list=code_block_7)
intersect = Geometry.Intersect(geometry=firstItem, other=lastItem)
explode = Geometry.Explode(geometry=intersect)
flatten = List.Flatten(list=explode)
normalAtParameter = Surface.NormalAtParameter(surface=flatten)
Z = Vector.Z(vector=normalAtParameter)
code_block_8 = CodeBlock { -1.00; }
allIndicesOf = List.AllIndicesOf(list=Z, item=code_block_8)
getItemAtIndex_3 = List.GetItemAtIndex(list=flatten, index=allIndicesOf)
pointAtParameter = Surface.PointAtParameter(surface=getItemAtIndex_3)
explode_2 = Geometry.Explode(geometry=code_block_7)
flatten_2 = List.Flatten(list=explode_2)
normalAtParameter_2 = Surface.NormalAtParameter(surface=flatten_2)
Z_2 = Vector.Z(vector=normalAtParameter_2)
code_block_9 = CodeBlock { -1.00; }
allIndicesOf_2 = List.AllIndicesOf(list=Z_2, item=code_block_9)
getItemAtIndex_4 = List.GetItemAtIndex(list=flatten_2, index=allIndicesOf_2)
perimeterCurves = Surface.PerimeterCurves(surface=getItemAtIndex_4)
byJoinedCurves = PolyCurve.ByJoinedCurves(curves=perimeterCurves)
pointAtParameter_2 = Curve.PointAtParameter(curve=byJoinedCurves)
code_block_10 = CodeBlock { 0..1..0.01; }
