# Dynamo graph Home.dyn (Dynamo 2.13.1.3887)

python_script = Python()  # CPython3; unwired: IN[0]
# ---------- python_script.python (27 lines) ----------
# Load the Python Standard and DesignScript Libraries
import sys
import clr
clr.AddReference('ProtoGeometry')
from Autodesk.DesignScript.Geometry import *
import numpy as np
import pandas as pd
# The inputs to this node will be stored as a list in the IN variables.
dataEnteringNode = IN

# Place your code below this line
dataFrame = pd.DataFrame({
	"Name": ["Odinson, Thor",
		"Maximoff, Wanda",
		"Banner, Dr. Bruce",
		"Romanoff, Natasha",
		"Stark, Tony",
		"Danvers, Carol ",
		"Rogers, Steve"],
	"Age": [1505, 24, 54, 39, 53, 65, 38],
	"Sex": ["male","female","male",
		"female","male","female",
		"male"]
})

# Assign your output to the OUT variable.
OUT = repr(dataFrame)
# ----------------------------------------
python_script_2 = Python()  # CPython3; unwired: IN[0]
# ---------- python_script_2.python (20 lines) ----------
# Load the Python Standard and DesignScript Libraries
import sys
import clr
clr.AddReference('ProtoGeometry')
from Autodesk.DesignScript.Geometry import *

import numpy as np
import matplotlib.pyplot as plt

# The inputs to this node will be stored as a list in the IN variables.
dataEnteringNode = IN

# Place your code below this line
A = np.arange(2*3*4).reshape([2,3,4])
B = np.arange(2*3*4).reshape([2,4,3])-1

a = np.arange(0, 10, 2, np.float)
plt.plot(a, 'o')
# Assign your output to the OUT variable.
OUT = plt.figure()
# ----------------------------------------
watch_image = WatchImageCore(image=python_script_2)
