# Dynamo graph nodemodelchart Test.dyn (Dynamo 2.10.1.3976)
# packages: NodeModelCharts 2.0.2

code_block = CodeBlock { "a"; }
code_block_2 = CodeBlock()
# ---------- code_block_2.designscript (4 lines) ----------
[
"a",
"b"
];
# ----------------------------------------
code_block_3 = CodeBlock()
# ---------- code_block_3.designscript (8 lines) ----------
[
[1,
2,
3],
[4,
5,
6]
];
# ----------------------------------------
code_block_4 = CodeBlock { 10; }
mul = code_block_3 * code_block_4
color_palette = ColorPalette({R: 0, G: 0, B: 255, A: 255})
color_palette_2 = ColorPalette({R: 138, G: 43, B: 226, A: 255})
color_palette_3 = ColorPalette({R: 165, G: 42, B: 42, A: 255})
color_palette_4 = ColorPalette({R: 222, G: 184, B: 135, A: 255})
color_palette_5 = ColorPalette({R: 95, G: 158, B: 160, A: 255})
color_palette_6 = ColorPalette({R: 127, G: 255, B: 0, A: 255})
color_palette_7 = ColorPalette({R: 210, G: 105, B: 30, A: 255})
join = List.Join(list0=color_palette, list1=color_palette_2, list2=color_palette_3, list3=color_palette_4, list4=color_palette_5, list5=color_palette_6, list6=color_palette_7)
bar_chart = BarChartNodeModel(labels=code_block_2, values=mul, colors=join, Labels=["a", "b"], Values=[[10, 20, 30], [40, 50, 60]], Colors=["#FFE04ABB", "#FF7A62F7"])  # graph output
heat_series_plot = HeatSeriesNodeModel()  # unwired: x_labels, y_labels, values, colors
index_value_line_plot = BasicLineChartNodeModel()  # unwired: labels, values, colors
code_block_5 = CodeBlock()
# ---------- code_block_5.designscript (5 lines) ----------
[
"a",
"b",
"c"
];
# ----------------------------------------
code_block_6 = CodeBlock()
# ---------- code_block_6.designscript (5 lines) ----------
[
1,
2,
3
];
# ----------------------------------------
pie_chart = PieChartNodeModel(labels=code_block_5, values=code_block_6, colors=join, Labels=["a", "b", "c"], Values=[1, 2, 3], Colors=["#FF126267", "#FF18610E", "#FFDAB0FD"])  # graph output
scatter_plot = ScatterPlotNodeModel()  # unwired: labels, x_values, y_values, colors
xy_line_plot = XYLineChartNodeModel()  # unwired: labels, x_values, y_values, colors
