# Dynamo graph logStudy.dyn (Dynamo 2.12.0.5650)

python_script = Python()  # CPython3; unwired: IN[0]
# ---------- python_script.python (18 lines) ----------
# Load the Python Standard and DesignScript Libraries
import sys
import clr
clr.AddReference('ProtoGeometry')
from Autodesk.DesignScript.Geometry import *

# The inputs to this node will be stored as a list in the IN variables.
dataEnteringNode = IN

# Place your code below this line
import logging

logger = logging.getLogger()
handler = logging.FileHandler(r'd:\test\logfile.log')
logger.addHandler(handler)
logger.error('Our First Log Message!!')
# Assign your output to the OUT variable.
OUT = 0
# ----------------------------------------
