# Dynamo graph strategy_modify_fn.dyn (Dynamo 2.12.0.5650)

python_script = Python()  # CPython3; unwired: IN[0]
# ---------- python_script.python (90 lines) ----------
# Python 표준 및 DesignScript 라이브러리 로드
import sys
import clr
clr.AddReference('ProtoGeometry')
from Autodesk.DesignScript.Geometry import *

# 이 노드에 대한 입력값은 IN 변수에 리스트로 저장됩니다.
dataEnteringNode = IN

# 코드를 이 선 아래에 배치

import string
import random
from typing import List, Callable
from abc import ABC, abstractmethod

class SupportTicket:
    def __init__(self, customer, issue):
        self.id = generate_id()
        self.customer = customer
        self.issue = issue

def generate_id(length=8):
    # helper function for generating an id
    return ''.join(random.choices(string.ascii_uppercase, k=length))


def fifo_ordering(list: List[SupportTicket]) -> List[SupportTicket]:
    return list.copy()

def filo_ordering(list: List[SupportTicket]) -> List[SupportTicket]:
    list_copy = list.copy()
    list_copy.reverse()
    return list_copy

def random_ordering(list: List[SupportTicket]) -> List[SupportTicket]:
    list_copy = list.copy()
    random.shuffle(list_copy)
    return list_copy

def black_hole_ordering(list: List[SupportTicket]) -> List[SupportTicket]:
    return []


class CustomerSupport:

    def __init__(self):
        self.tickets = []
        

    def create_ticket(self, customer, issue):
        self.tickets.append(SupportTicket(customer, issue))

    def process_tickets(self, processing_strategy_fn: Callable[[List[SupportTicket]], List[SupportTicket]]):
        # create the ordered list
        ticket_list = processing_strategy_fn(self.tickets)
        result = []
        # if it's empty, don't do anything
        if len(ticket_list) == 0:
            print("There are no tickets to process. Well done!")
            return
        

        for ticket in ticket_list:
            result.append(self.process_ticket(ticket))
        
        return result


    def process_ticket(self, ticket: SupportTicket):
        result = []
        
        result.append(f"Processing ticket id: {ticket.id}")
        result.append(f"Customer: {ticket.customer}")
        result.append(f"Issue: {ticket.issue}")
        
        return result


# create the application
app = CustomerSupport()

# register a few tickets
app.create_ticket("John Smith", "My computer makes strange sounds!")
app.create_ticket("Linus Sebastian", "I can't upload any videos, please help.")
app.create_ticket("Arjan Egges", "VSCode doesn't automatically solve my bugs.")


# 출력을 OUT 변수에 지정합니다.
OUT = app.process_tickets(random_ordering)
# ----------------------------------------
