# Dynamo graph Home.dyn (Dynamo 2.12.0.5650)

python_script = Python()  # CPython3; unwired: IN[0]
# ---------- python_script.python (23 lines) ----------
# Python 표준 및 DesignScript 라이브러리 로드
import os
python_rootpath = os.getenv('LOCALAPPDATA')+'\Programs\Python'
file_list = os.listdir(python_rootpath)
python_version = file_list[-1]
import sys
sys.path.append(os.getenv('LOCALAPPDATA').replace('\\','\\\\') + f'\Programs\Python\{python_version}\Lib\site-packages')
import clr
clr.AddReference('ProtoGeometry')
from Autodesk.DesignScript.Geometry import *

# 이 노드에 대한 입력값은 IN 변수에 리스트로 저장됩니다.
dataEnteringNode = IN

# 코드를 이 선 아래에 배치
import telegram as tel

bot = tel.Bot(token="5005592604:AAGX4MPE0G16VwSLdpmRVvXG_rafU_uKgzA")
chat_id = 628281989

bot.sendMessage(chat_id=chat_id, text="Test Message From Dynamo") # 메세지 보내기
# 출력을 OUT 변수에 지정합니다.
OUT = 0
# ----------------------------------------
