# Dynamo graph yieldTest_20220201.dyn (Dynamo 2.12.0.5650)

categories = Categories("OST_StructuralFoundation")
all_elements_of_category = ElementsOfCategory(Category=categories)
code_block = CodeBlock(i=all_elements_of_category) { i[169]; }
boolean = BoolSelector(false)
code_block_2 = CodeBlock { 300; }
code_block_3 = CodeBlock { 50; }
code_block_4 = CodeBlock { 2; }
python_script = Python(IN[2]=code_block, IN[3]=boolean, IN[4]=code_block_2, IN[5]=code_block_3, IN[6]=code_block_4)  # CPython3; unwired: IN[0], IN[1]
# ---------- python_script.python (127 lines) ----------
# Load the Python Standard and DesignScript Libraries
import sys
import clr

clr.AddReference('RevitAPI')
from Autodesk.Revit.DB import *
import Autodesk

clr.AddReference('RevitNodes')
import Revit
clr.ImportExtensions(Revit.Elements)

clr.AddReference('RevitServices')
import RevitServices
from RevitServices.Persistence import DocumentManager
doc = DocumentManager.Instance.CurrentDBDocument
collector1 = FilteredElementCollector(doc)#Autodesk.Revit.DB.FilteredElementCollector(doc)

clr.AddReference('ProtoGeometry')
from Autodesk.DesignScript.Geometry import *

def gen_AllStructuralFoundation():
    doc = DocumentManager.Instance.CurrentDBDocument
    collector = FilteredElementCollector(doc).OfCategory(BuiltInCategory.OST_StructuralFoundation).WhereElementIsNotElementType().ToElements()
    for i in collector:
        yield i.ToDSType(False)

def gen_AllStructuralColumns():
    doc = DocumentManager.Instance.CurrentDBDocument
    collector = FilteredElementCollector(doc).OfCategory(BuiltInCategory.OST_StructuralColumns).WhereElementIsNotElementType().ToElements()
    for i in collector:
        yield i.ToDSType(False)

def len_gen(gen):
    length = 0
    for x in gen:
        length += 1
    return length

def gen_AllCondiThings(gen_mother, condition):
    for i in gen_mother:
        if  condition in i.Name:
            yield i

# The inputs to this node will be stored as a list in the IN variables.
dataEnteringNode = IN
#input0 = next(gen_AllStructuralFoundation())
#input = next(gen_AllStructuralFoundation())

refFunc = IN[0]
tag = IN[1]
input = IN[2]

wholeExcavationBln = IN[3]
bttmOffset = IN[4]
버림thk = IN[5]
slopeExcav = IN[6]
# Place your code below this line
def 터파기산출함수(input):
    if wholeExcavationBln:
    
        calcTargetNum = len_gen(gen_AllStructuralFoundation())
        allIsoFdns = (i for i in gen_AllStructuralFoundation() if "Footing-" in i.Name)
        fdnsGeo = (i.Geometry()[0] for i in allIsoFdns)
        bdBox_fdn = BoundingBox.ByGeometry(fdnsGeo).ToCuboid()
        srfs = bdBox_fdn.Explode()
        belowSrf = [i for i in srfs if i.NormalAtParameter(0.5,0.5).Z == -1][0]
        
        def getSrfHeight(srf):
            _crvs = srf.PerimeterCurves()
            heights = (i.StartPoint.Z for i in _crvs)
            height = min(heights)
            return height
        belowSrf_height = getSrfHeight(belowSrf)
        
        def offsetCrv(crv, offset=300):
            return crv.Offset(offset)
        def correctElev(crv, thk):
            return crv.Translate(0,0,thk)
    
        _exca_belowbdry = offsetCrv(PolyCurve.ByJoinedCurves(belowSrf.PerimeterCurves()), bttmOffset)
        exca_belowbdry = correctElev(_exca_belowbdry, -버림thk)
        _exca_upperbdry = correctElev(_exca_belowbdry, -belowSrf_height)
        exca_upperbdry = offsetCrv(_exca_upperbdry, -belowSrf_height/slopeExcav)
        target = Solid.ByLoft([exca_belowbdry,exca_upperbdry])
        targetGeo = target
        targetValue = sum([i.Volume for i in [target]])/calcTargetNum/1000000000

    else:
        calcTargetNum = 1
        srfs = input.Geometry()[0].Explode()
        belowSrf = [i for i in srfs if i.NormalAtParameter(0.5,0.5).Z == -1][0]
        
        def getSrfHeight(srf):
            _crvs = srf.PerimeterCurves()
            heights = (i.StartPoint.Z for i in _crvs)
            height = min(heights)
            return height
        belowSrf_height = getSrfHeight(belowSrf)
        
        def findLeanThk(leanobj):
            if leanobj:
                return leanobj.GetParameterValueByName("thk")
            else:
                return 버림thk
        leanobj = None
        leanthk = findLeanThk(leanobj)
        
        def offsetCrv(crv, offset=300):
            return crv.Offset(offset)
        def correctElev(crv, thk):
            return crv.Translate(0,0,thk)
        _exca_belowbdry = offsetCrv(PolyCurve.ByJoinedCurves(belowSrf.PerimeterCurves()), bttmOffset)
        exca_belowbdry = correctElev(_exca_belowbdry, -버림thk)
        _exca_upperbdry = correctElev(_exca_belowbdry, -belowSrf_height)
        exca_upperbdry = offsetCrv(_exca_upperbdry, -belowSrf_height/slopeExcav)
        target = Solid.ByLoft([exca_belowbdry,exca_upperbdry])
        targetGeo = target
        targetValue = sum([i.Volume for i in [target]])/calcTargetNum/1000000000

    yield (targetGeo, targetValue, "M3")


# Assign your output to the OUT variable.
alls = gen_AllCondiThings(gen_AllStructuralFoundation(), "Footing-")
OUT = (터파기산출함수(i) for i in alls)
#OUT = (터파기산출함수,tag[0],tag[1],["M3"])
# ----------------------------------------
python_script_2 = Python()  # CPython3; unwired: IN[0]
# ---------- python_script_2.python (52 lines) ----------
# Load the Python Standard and DesignScript Libraries
import sys
import clr

clr.AddReference('RevitAPI')
from Autodesk.Revit.DB import *
import Autodesk

clr.AddReference('RevitNodes')
import Revit
clr.ImportExtensions(Revit.Elements)

clr.AddReference('RevitServices')
import RevitServices
from RevitServices.Persistence import DocumentManager
doc = DocumentManager.Instance.CurrentDBDocument
collector1 = FilteredElementCollector(doc)#Autodesk.Revit.DB.FilteredElementCollector(doc)

clr.AddReference('ProtoGeometry')
from Autodesk.DesignScript.Geometry import *

def gen_AllStructuralFoundation():
    doc = DocumentManager.Instance.CurrentDBDocument
    collector = FilteredElementCollector(doc).OfCategory(BuiltInCategory.OST_StructuralFoundation).WhereElementIsNotElementType().ToElements()
    for i in collector:
        yield i.ToDSType(False)

def gen_AllStructuralColumns():
    doc = DocumentManager.Instance.CurrentDBDocument
    collector = FilteredElementCollector(doc).OfCategory(BuiltInCategory.OST_StructuralColumns).WhereElementIsNotElementType().ToElements()
    for i in collector:
        yield i.ToDSType(False)

def len_gen(gen):
    length = 0
    for x in gen:
        length += 1
    return length

def gen_AllCondiThings(gen_mother, condition):
    for i in gen_mother:
        if  condition in i.Name:
            yield i

# The inputs to this node will be stored as a list in the IN variables.
dataEnteringNode = IN

# Place your code below this line
#result = gen_AllStructuralColumns()
result = gen_AllCondiThings(gen_AllStructuralFoundation(), "Footing-")
# Assign your output to the OUT variable.
OUT = result
# ----------------------------------------
