# Dynamo graph meetEach.dyn (Dynamo 2.12.0.5650)

python_script = Python()  # CPython3; unwired: IN[0]
# ---------- python_script.python (13 lines) ----------
# Load the Python Standard and DesignScript Libraries
import sys
import clr
clr.AddReference('ProtoGeometry')
from Autodesk.DesignScript.Geometry import *

# The inputs to this node will be stored as a list in the IN variables.
dataEnteringNode = IN

# Place your code below this line

# Assign your output to the OUT variable.
OUT = dir(Cuboid)
# ----------------------------------------
byCoordinates = Point.ByCoordinates()
byCenterPointRadius = Sphere.ByCenterPointRadius(centerPoint=byCoordinates)
code_block = CodeBlock { 10; 1.4; }
byCoordinates_2 = Point.ByCoordinates(y=code_block.out1)
byLengths = Cuboid.ByLengths(origin=byCoordinates_2)
boolean = BoolSelector(false)
join = List.Join(list0=byCenterPointRadius, list1=byLengths, list2=boolean)
python_script_2 = Python(IN[0]=join)  # CPython3
# ---------- python_script_2.python (31 lines) ----------
# Load the Python Standard and DesignScript Libraries
import sys
import clr
clr.AddReference('ProtoGeometry')
from Autodesk.DesignScript.Geometry import *

# The inputs to this node will be stored as a list in the IN variables.
dataEnteringNode = IN
els = IN[0]

# Place your code below this line

## 두가지 형상을 서로의 최단거리 선분의 중점에서 만나도록 하는 코드
def meetEach(els):
    if len(els) == 3 and els[2]:
        shortPoints = [els[0].ClosestPointTo(els[1]), els[1].ClosestPointTo(els[0])]
        _vec = Vector.ByTwoPoints(shortPoints[1], shortPoints[0])
        transGeos  = [els[0], els[1].Translate(_vec)]
    else:
        shortPoints = [els[0].ClosestPointTo(els[1]), els[1].ClosestPointTo(els[0])]
        _line = Line.ByStartPointEndPoint(shortPoints[0], shortPoints[1])
        midPoint = _line.PointAtParameter(0.5)
        _vecs = [Vector.ByTwoPoints(shortPoints[0], midPoint), Vector.ByTwoPoints(shortPoints[1], midPoint)]
        transGeos  = [els[0].Translate(_vecs[0]), els[1].Translate(_vecs[1])]
        
    return transGeos

result = meetEach(els)
#result = el.ComputeHashCode()
# Assign your output to the OUT variable.
OUT = result
# ----------------------------------------
code_block_2 = CodeBlock { -10; }
pointAtParameter = Curve.PointAtParameter()  # unwired: curve
python_script_3 = Python(IN[0]=join)  # CPython3
# ---------- python_script_3.python (31 lines) ----------
# Load the Python Standard and DesignScript Libraries
import sys
import clr
clr.AddReference('ProtoGeometry')
from Autodesk.DesignScript.Geometry import *

# The inputs to this node will be stored as a list in the IN variables.
dataEnteringNode = IN
els = IN[0]

# Place your code below this line

## 두가지 형상을 서로의 최단거리 선분의 중점에서 만나도록 하는 코드
def meetEach(els):
    if len(els) == 3 and els[2]:
        shortPoints = [els[0].ClosestPointTo(els[1]), els[1].ClosestPointTo(els[0])]
#        _vec = Vector.ByTwoPoints(shortPoints[1], shortPoints[0])
        transGeos  = shortPoints#[els[0], els[1].Translate(_vec)]
    else:
        shortPoints = [els[0].ClosestPointTo(els[1]), els[1].ClosestPointTo(els[0])]
#        _line = Line.ByStartPointEndPoint(shortPoints[0], shortPoints[1])
#        midPoint = _line.PointAtParameter(0.5)
#        _vecs = [Vector.ByTwoPoints(shortPoints[0], midPoint), Vector.ByTwoPoints(shortPoints[1], midPoint)]
        transGeos  = shortPoints#[els[0].Translate(_vecs[0]), els[1].Translate(_vecs[1])]
        
    return transGeos

result = meetEach(els)
#result = el.ComputeHashCode()
# Assign your output to the OUT variable.
OUT = result
# ----------------------------------------
closestPointTo = Geometry.ClosestPointTo(geometry=byCenterPointRadius, other=byLengths)
