# Dynamo graph Wall Calculator_HEC(0625).dyn "Wall Calculator_mk(0616)" (Dynamo 2.6.1.8786)

# group: 산출기준표 import
file_path = Filename("..\..\07_3D 기반 물량 집계 자동화\BIM_물량집계 자동화 산출기준표_rC(20210607)_mk_de.xlsx")
file_from_path = FileObject(path=file_path)
code_block = CodeBlock { "Scope_lv2(Walls)"; }
code_block_2 = CodeBlock { false; }
importExcel = Data.ImportExcel(file=file_from_path, sheetName=code_block, showExcel=code_block_2)
code_block_3 = CodeBlock { " "; }
isNull = Object.IsNull()  # unwired: obj
replaceByCondition = Replace(item=importExcel, replaceWith=code_block_3, condition=isNull)
transpose = List.Transpose(lists=replaceByCondition)
count = List.Count(list=transpose)
현재_카테고리_내에서_쓰일_total_wm_code = CodeBlock()  # frozen
# ---------- 현재_카테고리_내에서_쓰일_total_wm_code.designscript (18 lines) ----------
i = [

"A03AC032",
"A03AC033",
"A03AC035",
"A03AC036",
"A03AC037",
"A03AE056",
"A03AE057",
"A03AE058",
"A03AE059",
"A03AE060",
"A03AE061",
"A03AH062",
"A03AH058",
"A03AH063"

];
# ----------------------------------------
code_block_4 = CodeBlock(i=transpose) { i[0]+"_"+i[1]+"_"+i[2]+"_"+i[3]; }
watch = Watch(code_block_4)
code_block_5 = CodeBlock(i=importExcel) { i[3]; }
code_block_6 = CodeBlock { 4; ""; }

# group: select all Category element
categories = Categories("OST_Walls")
all_elements_of_category = ElementsOfCategory(Category=categories)

# group: select all Category element by level
code_block_7 = CodeBlock { "Base Constraint"; }
getParameterValueByName = Element.GetParameterValueByName(parameterName=code_block_7)  # unwired: element
groupByFunction = List.GroupByFunction(list=all_elements_of_category, func=getParameterValueByName)

# group: Family Type 별 sorting
elementType = Element.ElementType()  # unwired: element
uniqueItems = List.UniqueItems(list=elementType)
groupByFunction_2 = List.GroupByFunction(list=groupByFunction@L2, func=uniqueItems)

# note: out element
name = Family.Name(family=groupByFunction_2)

# group: element-wm 별 면적(m2) 물량 추출 구간
# note: in element
getMaterials = Element.GetMaterials(element=groupByFunction_2)
code_block_8 = CodeBlock { "Area"; }
getParameterValueByName_2 = Element.GetParameterValueByName(element=groupByFunction_2, parameterName=code_block_8)
flatten = List.Flatten(list=getParameterValueByName_2)
watch_2 = Watch(flatten)
count_2 = List.Count(list=getMaterials@L2)
ofRepeatedItem = List.OfRepeatedItem(item=watch_2, amount=count_2, lacing=Shortest)
flatten_2 = List.Flatten(list=ofRepeatedItem)

watch_3 = Watch(getMaterials)
name_2 = Material.Name(material=watch_3)
watch_4 = Watch(name_2)
flatten_3 = List.Flatten(list=watch_4)
watch_5 = Watch(flatten_3)
watch_6 = Watch(flatten_2)

# group: input list 에서 대상문자열들 포함하는 index 추출(for line base)
대상_문자열 = CodeBlock()
# ---------- 대상_문자열.designscript (5 lines) ----------
[

"Skirt"

];
# ----------------------------------------
code_block_9 = CodeBlock(str=flatten_3, searchFor=대상_문자열) { String.Contains(str<1>, searchFor, false); }
allFalse = List.AllFalse(list=code_block_9@L2)
code_block_10 = CodeBlock { false; }
allIndicesOf = List.AllIndicesOf(list=allFalse, item=code_block_10)

# group: element-wm 별 길이(m) 물량 추출 구간
code_block_11 = CodeBlock { "Length"; }
getParameterValueByName_3 = Element.GetParameterValueByName(element=groupByFunction_2, parameterName=code_block_11)
flatten_4 = List.Flatten(list=getParameterValueByName_3)
watch_7 = Watch(flatten_4)
getMaterials_2 = Element.GetMaterials(element=groupByFunction_2)
count_3 = List.Count(list=getMaterials_2@L2)
ofRepeatedItem_2 = List.OfRepeatedItem(item=watch_7, amount=count_3, lacing=Shortest)
flatten_5 = List.Flatten(list=ofRepeatedItem_2)

code_block_12 = CodeBlock(i=flatten_5) { i / 1000; }
watch_8 = Watch(code_block_12)

# group: element-wm 별 적합 물량 매칭 구간
watch_9 = Watch(flatten_2)
watch_10 = Watch(allIndicesOf)
getItemAtIndex = List.GetItemAtIndex(list=watch_8, index=allIndicesOf)
watch_11 = Watch(getItemAtIndex)
code_block_13 = CodeBlock(inList=watch_9, replaceIndex=watch_10, replaceValue=watch_11)
# ---------- code_block_13.designscript (6 lines) ----------
numIndex = 0..List.Count(inList)-1;
numIndexDiffer = List.SetDifference(numIndex,replaceIndex);
numIndexFlatten = List.Flatten([numIndexDiffer,replaceIndex],-1);
bln1 = List.Contains(replaceIndex,numIndex<1>);
outList = List.FilterByBoolMask(inList,bln1);
outListFlatten = List.Flatten([outList["out"],replaceValue],-1);
# ----------------------------------------
watch_12 = Watch(code_block_13.bln1)
watch_13 = Watch(code_block_13.outList)
sortByKey = List.SortByKey(list=code_block_13.outListFlatten, keys=code_block_13.numIndexFlatten)
watch_14 = Watch(sortByKey.sorted_list)

# group: element 별 위치정보 삽입 구간
code_block_14 = CodeBlock {  }
code_block_15 = CodeBlock {  }

# group: element 별 Family Type 삽입 구간
code_block_16 = CodeBlock {  }
code_block_17 = CodeBlock {  }

# group: element 별 WM code 삽입 구간
code_block_18 = CodeBlock {  }
code_block_19 = CodeBlock {  }

# group: input list 에서 대상문자열들 포함하는 index 추출(for forms)
대상_문자열_2 = CodeBlock()
# ---------- 대상_문자열_2.designscript (6 lines) ----------
[

"Form"


];
# ----------------------------------------
code_block_20 = CodeBlock(str=flatten_3, searchFor=대상_문자열_2) { String.Contains(str<1>, searchFor, false); }
allFalse_2 = List.AllFalse(list=code_block_20@L2)
code_block_21 = CodeBlock { false; }
allIndicesOf_2 = List.AllIndicesOf(list=allFalse_2, item=code_block_21)

element_wm_별_면적_형상 = CodeBlock(i=flatten_2) { i; }

# group: element-wm 별 적합 물량 매칭 구간
watch_15 = Watch(watch_14)
watch_16 = Watch(allIndicesOf_2)
getItemAtIndex_2 = List.GetItemAtIndex(list=element_wm_별_면적_형상, index=allIndicesOf_2)

form_물량_보정 = CodeBlock(i=getItemAtIndex_2) { i * 2; }

# group (continued): element-wm 별 적합 물량 매칭 구간
watch_17 = Watch(form_물량_보정)
code_block_22 = CodeBlock(inList=watch_15, replaceIndex=watch_16, replaceValue=watch_17)  # same code as code_block_13
sortByKey_2 = List.SortByKey(list=code_block_22.outListFlatten, keys=code_block_22.numIndexFlatten)
watch_18 = Watch(sortByKey_2.sorted_list)

# group: wm 별 할증값 생성구간
code_block_23 = CodeBlock {  }
code_block_24 = CodeBlock {  }

code_block_25 = CodeBlock { "Base Constraint"; }
parameterByName = Parameter.ParameterByName(element=groupByFunction_2, name=code_block_25)
code_block_26 = CodeBlock(t1=groupByFunction) { t2 = Element.GetParameterValueByName(t1, "Base Constraint"); }
watch_19 = Watch(code_block_26)
wall_types = WallTypes("CWW111_Wall_RC_T120")
kind = WallType.Kind(wallType=wall_types)
function = WallType.Function(wallType=wall_types)
name_3 = WallType.Name(wallType=wall_types)
parameters = Element.Parameters(element=groupByFunction)
rank = List.Rank(list=parameters)

# group: 모델링에 사용된 모든 패밀리타입 추출
elementType_2 = Element.ElementType(element=groupByFunction)
name_4 = Element.Name(element=elementType_2)
uniqueItems_2 = List.UniqueItems(list=name_4@L2)
flatten_6 = List.Flatten(list=uniqueItems_2)
watch_20 = Watch(flatten_6)
code_block_27 = CodeBlock { "_"; }
split = String.Split(str=watch_20, separator0=code_block_27)
firstItem = List.FirstItem(list=split@L2)

# group: 모델링에 사용된 모든 패밀리타입 추출 및 칼럼 번호 추출
watch_21 = Watch(code_block_5)
code_block_28 = CodeBlock { ""; }
isNull_2 = Object.IsNull()  # unwired: obj
replaceByCondition_2 = Replace(item=watch_21, replaceWith=code_block_28, condition=isNull_2)
contains = String.Contains(str=replaceByCondition_2, searchFor=firstItem, lacing=CrossProduct)
allFalse_3 = List.AllFalse(list=contains@L2)
code_block_29 = CodeBlock(i=allFalse_3) { i==false?true:false; }
code_block_30 = CodeBlock { true; }
allIndicesOf_3 = List.AllIndicesOf(list=code_block_29, item=code_block_30)

# group (continued): 산출기준표 import
getItemAtIndex_3 = List.GetItemAtIndex(list=transpose, index=allIndicesOf_3)
replaceItemAtIndex = List.ReplaceItemAtIndex(list=getItemAtIndex_3@L2, index=code_block_6.out0, item=code_block_6.out1)

count_4 = List.Count(list=replaceItemAtIndex)
count_5 = List.Count(list=replaceItemAtIndex@L2)
count_6 = List.Count(list=replaceItemAtIndex@L1)

# group: 사용된 패밀리 타입에서 세부코드가 기입된 Row 열 번호 추출
string_from_object = FromObject(obj=replaceItemAtIndex)
code_block_31 = CodeBlock { "000"; }
contains_2 = String.Contains(str=string_from_object@L2, searchFor=code_block_31, lacing=CrossProduct)
code_block_32 = CodeBlock { true; }
allIndicesOf_4 = List.AllIndicesOf(list=contains_2@L2, item=code_block_32)

watch_22 = Watch(string_from_object)

# group: 원본 column 정렬
code_block_33 = CodeBlock(i=transpose) { i; }

# group: 원본 row 정렬
code_block_34 = CodeBlock(i=replaceByCondition) { i; }

code_block_35 = CodeBlock(i=code_block_34) { i[3]; }
watch_23 = Watch(code_block_35)
watch_24 = Watch(allIndicesOf_4)
getItemAtIndex_4 = List.GetItemAtIndex(list=code_block_34, index=watch_24@L2)
watch_25 = Watch(getItemAtIndex_4)
rank_2 = List.Rank(list=watch_4@L3)
watch_26 = Watch(firstItem)
watch_27 = Watch(replaceItemAtIndex)
code_block_36 = CodeBlock { 3; }
getItemAtIndex_5 = List.GetItemAtIndex(list=watch_27@L2, index=code_block_36)
code_block_37 = CodeBlock { "_"; "-"; }
split_2 = String.Split(str=getItemAtIndex_5, separator0=code_block_37.out0, separator1=code_block_37.out1)
firstItem_2 = List.FirstItem(list=split_2@L2)
code_block_38 = CodeBlock { 0; }
getItemAtIndex_6 = List.GetItemAtIndex(list=getItemAtIndex_4@@L2, index=code_block_38)
watch_28 = Watch(getItemAtIndex_6)
getItemAtIndex_7 = List.GetItemAtIndex(list=watch_27@L2, index=watch_24@L2)
watch_29 = Watch(getItemAtIndex_7)
code_block_39 = CodeBlock(i=watch_28, j=watch_29) { i + "-" + j; }
byKeysValues = DesignScript.Builtin.Dictionary.ByKeysValues(keys=firstItem_2, values=code_block_39)
watch_30 = Watch(byKeysValues)
value = Parameter.Value(parameter=parameters)
watch_31 = Watch(firstItem)

# group: Family Type 별 sorting
elementType_3 = Element.ElementType()  # unwired: element
uniqueItems_3 = List.UniqueItems(list=elementType_3)
groupByFunction_3 = List.GroupByFunction(list=all_elements_of_category@L2, func=uniqueItems_3)

byKeysValues_2 = DesignScript.Builtin.Dictionary.ByKeysValues(keys=watch_31, values=groupByFunction_3@L3)
components = DesignScript.Builtin.Dictionary.Components(dictionary=byKeysValues_2)

# group: select all Category element by level
code_block_40 = CodeBlock { "Base Constraint"; }
getParameterValueByName_4 = Element.GetParameterValueByName(parameterName=code_block_40)  # unwired: element
groupByFunction_4 = List.GroupByFunction(list=components.values@L2, func=getParameterValueByName_4)

code_block_41 = CodeBlock { 3; }
byKeysValues_3 = DesignScript.Builtin.Dictionary.ByKeysValues(keys=components.keys, values=components.values@L3)
count_7 = List.Count(list=ofRepeatedItem_2@L2)
sublists = List.Sublists(list=code_block_12, ranges=count_7)  # unwired: offset
