# Dynamo graph Home.dyn (Dynamo 2.12.0.5650)

python_script = Python()  # CPython3; unwired: IN[0]
# ---------- python_script.python (30 lines) ----------
# Load the Python Standard and DesignScript Libraries
import sys
import clr

clr.AddReference('RevitAPI')
import Autodesk.Revit.DB as DB

clr.AddReference('RevitServices')
from RevitServices.Persistence import DocumentManager
doc = DocumentManager.Instance.CurrentDBDocument

clr.AddReference('RevitNodes')
import Revit
clr.ImportExtensions(Revit.Elements)


clr.AddReference('ProtoGeometry')
from Autodesk.DesignScript.Geometry import *

# The inputs to this node will be stored as a list in the IN variables.
dataEnteringNode = IN

# Place your code below this line

ueWrapper = None
wrappers = clr.GetClrType(Revit.Elements.ElementWrapper).GetMethods()


# Assign your output to the OUT variable.
OUT = wrappers
# ----------------------------------------
python_script_2 = Python()  # CPython3; unwired: IN[0]
# ---------- python_script_2.python (34 lines) ----------
# Load the Python Standard and DesignScript Libraries
import sys
import clr

clr.AddReference('RevitAPI')
import Autodesk.Revit.DB as DB

clr.AddReference('RevitServices')
from RevitServices.Persistence import DocumentManager
doc = DocumentManager.Instance.CurrentDBDocument

clr.AddReference('RevitNodes')
import Revit
clr.ImportExtensions(Revit.Elements)


clr.AddReference('ProtoGeometry')
from Autodesk.DesignScript.Geometry import *

# The inputs to this node will be stored as a list in the IN variables.
dataEnteringNode = IN

# Place your code below this line

ueWrapper = None
wrappers = clr.GetClrType(Revit.Elements.ElementWrapper).GetMethods()
for w in wrappers:
    if w.ToString().startswith("Revit.Elements.UnknownElement"):
        ueWrapper = w
        break


# Assign your output to the OUT variable.
OUT = ueWrapper
# ----------------------------------------
python_script_3 = Python()  # CPython3; unwired: IN[0]
# ---------- python_script_3.python (42 lines) ----------
# Load the Python Standard and DesignScript Libraries
import sys
import clr

clr.AddReference('RevitAPI')
import Autodesk.Revit.DB as DB

clr.AddReference('RevitServices')
from RevitServices.Persistence import DocumentManager
doc = DocumentManager.Instance.CurrentDBDocument

clr.AddReference('RevitNodes')
import Revit
clr.ImportExtensions(Revit.Elements)


clr.AddReference('ProtoGeometry')
from Autodesk.DesignScript.Geometry import *

# The inputs to this node will be stored as a list in the IN variables.
dataEnteringNode = IN

# Place your code below this line

ueWrapper = None
wrappers = clr.GetClrType(Revit.Elements.ElementWrapper).GetMethods()
for w in wrappers:
    if w.ToString().startswith("Revit.Elements.UnknownElement"):
        ueWrapper = w
        break

fec = DB.FilteredElementCollector(doc).OfClass(DB.View3D)
result = []
for i in fec:
    if i.IsTemplate:
#        result.append(i)
        result.append(ueWrapper.Invoke(None, (i, True)))
#        result.append(type(ueWrapper))
#        result.append(dir(i))

# Assign your output to the OUT variable.
OUT = result
# ----------------------------------------
