# Dynamo graph RGB OVERRIDE_수정.dyn (Dynamo 2.10.1.3976)

file_path = Filename(".\RGB OVERRIDE.xlsx")
file_from_path = FileObject(path=file_path)
string = StringInput("Hydronic Supply")
boolean = BoolSelector(false)
importExcel = Data.ImportExcel(file=file_from_path, sheetName=string, showExcel=boolean)
transpose = List.Transpose(lists=importExcel)
restOfItems = List.RestOfItems(list=transpose)
code_block = CodeBlock { 0; 1; 2; }
getItemAtIndex = List.GetItemAtIndex(list=restOfItems, index=code_block.out0)
getItemAtIndex_2 = List.GetItemAtIndex(list=restOfItems, index=code_block.out1)
getItemAtIndex_3 = List.GetItemAtIndex(list=restOfItems, index=code_block.out2)
byARGB = Color.ByARGB(r=getItemAtIndex, g=getItemAtIndex_2, b=getItemAtIndex_3)
overrideColorInView = Element.OverrideColorInView(color=byARGB)  # unwired: element
categories = Categories("OST_PipeCurves")
all_elements_of_category = ElementsOfCategory(Category=categories)
integer_slider = IntegerSlider(217, range=0..255 step 1)
name = Element.Name(element=all_elements_of_category)
code_block_2 = CodeBlock { " "; }
split = String.Split(str=name, separator0=code_block_2)
code_block_3 = CodeBlock { 0; }
getItemAtIndex_4 = List.GetItemAtIndex(list=split@L2, index=code_block_3)
uniqueItems = List.UniqueItems(list=getItemAtIndex_4)
sort = List.Sort(list=uniqueItems)

# group: 추가 수정부분
firstItem = List.FirstItem(list=importExcel@L2)
restOfItems_2 = List.RestOfItems(list=importExcel@L2)
byKeysValues = DesignScript.Builtin.Dictionary.ByKeysValues(keys=firstItem, values=restOfItems_2)
valueAtKey = DesignScript.Builtin.Dictionary.ValueAtKey(dictionary=byKeysValues, key=sort)
code_block_4 = CodeBlock { 0; }
getItemAtIndex_5 = List.GetItemAtIndex(list=valueAtKey@L2, index=code_block_4)
code_block_5 = CodeBlock { 1; }
getItemAtIndex_6 = List.GetItemAtIndex(list=valueAtKey@L2, index=code_block_5)
code_block_6 = CodeBlock { 2; }
getItemAtIndex_7 = List.GetItemAtIndex(list=valueAtKey@L2, index=code_block_6)
byARGB_2 = Color.ByARGB(a=integer_slider, r=getItemAtIndex_5, g=getItemAtIndex_6, b=getItemAtIndex_7)
overrideColorInView_2 = Element.OverrideColorInView(element=all_elements_of_category, color=byARGB_2)
