# Dynamo graph $1_Act_FamilyType Checker.dyn (Dynamo 2.16.1.2727)
# author: MK Jang
# Check Revit and Excel's Family Types

# group: Types From Revit
allFamilyTypesPerCat = Python()  # CPython3; unwired: IN[0]
# ---------- allFamilyTypesPerCat.python (60 lines) ----------
# Load the Python Standard and DesignScript Libraries
import sys
import clr
clr.AddReference('ProtoGeometry')
from Autodesk.DesignScript.Geometry import *

import DSRevitNodesUI

clr.AddReference('RevitNodes')
import Revit
clr.ImportExtensions(Revit.Elements)
from Revit import Elements

clr.AddReference('RevitAPI')
from Autodesk.Revit.DB import *
import Autodesk

clr.AddReference('RevitServices')
import RevitServices
from RevitServices.Persistence import DocumentManager
doc = DocumentManager.Instance.CurrentDBDocument
collector = FilteredElementCollector(doc)

# The inputs to this node will be stored as a list in the IN variables.
dataEnteringNode = IN

# Place your code below this line
#res = collector.OfCategory(BuiltInCategory.OST_Floors).WhereElementIsElementType().ToElements()


def getAllTypes(n):
    collector = FilteredElementCollector(doc)
    bics = [
        BuiltInCategory.OST_Floors, BuiltInCategory.OST_Roofs,
        BuiltInCategory.OST_Walls, BuiltInCategory.OST_StructuralFoundation,
        BuiltInCategory.OST_StructuralColumns, BuiltInCategory.OST_StructuralFraming,
        BuiltInCategory.OST_Ceilings, BuiltInCategory.OST_Doors,
        BuiltInCategory.OST_Windows, BuiltInCategory.OST_Stairs,
        #BuiltInCategory.OST_Railings,
        BuiltInCategory.OST_GenericModel
        ]
        
        
    allFamTypes = collector.OfCategory(bics[n]).WhereElementIsElementType().ToElements()
    
    return allFamTypes
    
def getAllRailingTypes():
    collector = FilteredElementCollector(doc)      
    allFamTypes = collector.OfCategory(BuiltInCategory.OST_Railings)  #.ToElements()
    
    return dir(allFamTypes)
    

# Assign your output to the OUT variable.
#OUT = dir(Elements.FloorType)
#OUT = list(map(lambda x: x.WhereElementIsElementType().ToElements(), allCollector))
rgs = range(11)
res = list(map(getAllTypes, rgs))
OUT = res
# ----------------------------------------
name = FamilyType.Name(familyType=allFamilyTypesPerCat)
categories = Categories("OST_StairsRailing")
all_elements_of_category = ElementsOfCategory(Category=categories)
code_block = CodeBlock { "Family and Type"; }
getParameterValueByName = Element.GetParameterValueByName(element=all_elements_of_category, parameterName=code_block)
uniqueItems = List.UniqueItems(list=getParameterValueByName)
code_block_2 = CodeBlock { "Type Name"; }
getParameterValueByName_2 = Element.GetParameterValueByName(element=uniqueItems, parameterName=code_block_2)
code_block_3 = CodeBlock { 10; }
insert = List.Insert(list=name, element=getParameterValueByName_2, index=code_block_3)

from_revit = CodeBlock(i=insert) { i; }
file_path_family_list = Filename("..\hecCalc\2023\documentum\0_Publish\플랜트건축팀_BIM_팀 표준 Family List_Rev.0_시연용_20231107.xlsx")  # graph input
file_from_path = FileObject(path=file_path_family_list)
code_block_4 = CodeBlock()
# ---------- code_block_4.designscript (16 lines) ----------
[
"WM-AR"
,"물량Param"
,"1.Floors"
,"2.Roofs"
,"3.Walls"
,"4.St Fdn"
,"5.St Col"
,"6.St Framing"
,"7.Ceilings"
,"8.Doors"
,"9.Windows"
,"10.Stairs"
,"11.Railings"
,"13.Generic"
];
# ----------------------------------------
boolean = BoolSelector(true)
importExcel = Data.ImportExcel(file=file_from_path, sheetName=code_block_4, showExcel=boolean)

# group: Types From Excel
lang_mode_영_한_select = BoolSelector(false)
excel_data = Python(IN[0]=lang_mode_영_한_select, IN[1]=importExcel, IN[2]=code_block_4)  # "Excel data dictionarizationScript"; CPython3
# ---------- excel_data.python (216 lines) ----------
# Load the Python Standard and DesignScript Libraries
import sys
import clr
clr.AddReference('ProtoGeometry')
from Autodesk.DesignScript.Geometry import *

from functools import reduce
from functools import partial

# The inputs to this node will be stored as a list in the IN variables.
dataEnteringNode = IN
lang_mode = IN[0]
wholeDatas = IN[1]
db = wholeDatas[1:]
allCatSheetsNames = IN[2][2:]

paramSheet = db[0]
allCatSheets = db[1:]

#db
# Place your code below this line
def make_UnifiedDict(dictsList):
    dicts_AllInOne = {}
    for d in dictsList:
        dict_k_v = d.items()
        for k,v in dict_k_v:
            dicts_AllInOne[k] = v
    return dicts_AllInOne

def find_IsInStr(target, str):
    if target == None or str == None:
        pass
    else:
        res = target in str
        return res
def find_range_by_columnItem(db, col_idx, sep_rule):
    tdb = list(map(lambda x: x[col_idx], db))
    last_idx_tdb = len(tdb)-1
    tdb_enum = enumerate(tdb)
    res = list(filter(lambda x: find_IsInStr(sep_rule, x[1]), tdb_enum))
    endidxs_tmp= list(map(lambda x: x[0]-1,res))
    endidxs_tmp.pop(0)
    endidxs = endidxs_tmp + [last_idx_tdb]
    famTypeNames = list(map(lambda x: x[1],res))
    famTypeNamesIdxs = list(map(lambda x: x[0],res))
    rangeSttIdxs = list(map(lambda x: x[0]+1,res))
    rangeEndIdxs = endidxs
    result = dict(zip(famTypeNames, zip(famTypeNamesIdxs, zip(rangeSttIdxs,rangeEndIdxs))))
    return result
    
    
def find_headersAtSheet(sheet):
    headers_sheet = map(lambda x: [x[1].replace("\n",""),x[0]], filter(lambda x: x[1] != None, enumerate(sheet[1])))
    
    return dict(headers_sheet)

def find_rangesAtSheet(sheet, hdrs_withIdx, trgt_hdr, trgt_str):
    return find_range_by_columnItem(sheet, hdrs_withIdx[trgt_hdr], trgt_str)


def get_DataOnRangesAtParamSheet(sheet):
    
    hdrs_withIdx = find_headersAtSheet(sheet)
    rangesATSheet = find_rangesAtSheet(sheet, hdrs_withIdx, "Q'ty Cal Type Tag", "-")
    title_idx = map(lambda x: x[0], rangesATSheet.values())
    calcType_colDatas = list(map(lambda x: x[hdrs_withIdx["Q'ty Cal Type Tag"]], sheet))
    calcTypes = list(map(lambda x: calcType_colDatas[x], title_idx))
    rgs_v = list(map(lambda x: x[1], rangesATSheet.values()))
    rgs_k = list(map(lambda x: x, rangesATSheet.keys()))
    
    hdrs_v = list(hdrs_withIdx.values())
    hdrs_k = list(hdrs_withIdx.keys())
    eff_hdrs_v = hdrs_v[2:]
    eff_hdrs_k = hdrs_k[2:]
    
    datas_allCalType = list(map(lambda x: sheet[x[0]-1:x[1]], rgs_v))
    
    def setDict_OnEachCalType(data_calType):
        paramName_lang = "패밀리 매개변수(from Revit) 영문판" if lang_mode is True else "패밀리 매개변수(from Revit) 한글판"
        calcTypeName = data_calType[0][2]
        data_calType_noneless = list(filter(lambda x: x[hdrs_withIdx["항목"]] != None, data_calType))
#        ## WM row 별 header명 과 짝짓기
        data_withHdrsIdx = list(map(lambda y: list(map(lambda x: y[x], eff_hdrs_v)), data_calType_noneless))
        dict_ = list(map(lambda x: dict(zip(eff_hdrs_k, x)), data_withHdrsIdx))
        dicts_noneless = list(map(lambda y: dict(filter(lambda x: x[1]!=None, y.items())),dict_))
#        ## dict_Cal Type 입력처리
        targetColName = "Q'ty Cal Type Tag"
        dicts_finalNoneless = []
        for d in dicts_noneless:
            d["Q'ty Cal Type Tag"] = calcTypeName
            
            if "입력값" in d.keys():
                d["applyForCalc"] = d["입력값"]
                dicts_finalNoneless.append(d)
            elif paramName_lang in d.keys():
                d["applyForCalc"] = d[paramName_lang]
                dicts_finalNoneless.append(d)
            else:
                pass
        
        return {calcTypeName: dicts_finalNoneless}
        
    return map(setDict_OnEachCalType, datas_allCalType)
    


def get_SymValDict_PerCalcType(dic):
    def findDictPerCalcType(dicList):
            dic = {}
            for i in dicList:
                dic[i["산출수식 약자"]] = i["applyForCalc"]
            return dic
    
    ks_forDic = list(dic.keys())
    vs_forDic = list(map(findDictPerCalcType, dic.values()))
    res = dict(zip(ks_forDic, vs_forDic))
    return res


def get_DataOnRangesAtCatSheet(catSheet):
    hdrs_withIdx = find_headersAtSheet(catSheet)
    rangesATSheet = find_rangesAtSheet(catSheet, hdrs_withIdx, "Family Type Name", "H_")
    title_idx = map(lambda x: x[0], rangesATSheet.values())
    calcType_colDatas = list(map(lambda x: x[hdrs_withIdx["Q'ty Cal Type Tag"]], catSheet))
    calcTypes = list(map(lambda x: calcType_colDatas[x], title_idx))
    rgs_v = list(map(lambda x: x[1], rangesATSheet.values()))
    rgs_k = list(map(lambda x: x, rangesATSheet.keys()))
    
    hdrs_v = list(hdrs_withIdx.values())
    hdrs_k = list(hdrs_withIdx.keys())
    
    datas_allFamType = list(map(lambda x: list(zip(catSheet[x[0]-1:x[1]], range(x[0]-1,x[1]))), rgs_v))
    
    def setDict_OnEachFamType(data_famType):  ## 최종적으로 산출식 없는 것 걸러내기 추가해야 함
        titleData = list(data_famType).pop(0)[0]
        
        famTypeName = titleData[hdrs_withIdx["Family Type Name"]]
        calcTypeName = titleData[hdrs_withIdx["Q'ty Cal Type Tag"]]
        data_famType_noneless = list(filter(lambda x: x[0][5] != None, data_famType))
        ## WM row 별 header명 과 짝짓기
        data_withHdrsIdx = list(map(lambda y: [list(map(lambda x: y[0][x], hdrs_v)), y[1]], data_famType_noneless))
        hdrs_k.append("rIDX")
        dict_ = list(map(lambda x: dict(zip(hdrs_k, x[0]+[x[1]])), data_withHdrsIdx))
        dicts_noneless = list(map(lambda y: dict(filter(lambda x: x[1]!=None, y.items())),dict_))
        ## dict_gauge, 물량산출식 없는 항목 처리
        dicts_final = []
        needDefault_ColName = "Gauge Code"
        noneRemove_ColName = "Dynamo 물량산출식"
        for d in dicts_noneless:
            d["Family Type Name"] = famTypeName
            
            if calcTypeName == None:
                pass            
            elif noneRemove_ColName in d.keys():
                d["Q'ty Cal Type Tag"] = calcTypeName
                d[needDefault_ColName] = ""
                dicts_final.append(d)

        return dicts_final
        
    dicts_allFamType = list(map(lambda x: setDict_OnEachFamType(list(x)), datas_allFamType))
    ds_famTypesAtCatSheet = dict(zip(rgs_k, dicts_allFamType))
    ds_famTypesAtCatSheet_effCalcType = dict(filter(lambda x: all(list(map(lambda i: "Q'ty Cal Type Tag" in i, x[1]))), list(ds_famTypesAtCatSheet.items())))
    ds_famTypesAtCatSheet_noneless = dict(filter(lambda x: len(list(x[1]))!=0, list(ds_famTypesAtCatSheet_effCalcType.items())))
    
    return  ds_famTypesAtCatSheet_noneless

def make_AIOdic(allCatSheets):

    dataOnRanges_allCat = list(map(get_DataOnRangesAtCatSheet, allCatSheets))
    dataOnRanges_allCat_WithCatNames = list(zip(allCatSheetsNames, dataOnRanges_allCat))
    
    AIOdic = {}
    for d in dataOnRanges_allCat_WithCatNames:
        catName = d[0]
        dict_k_v = d[1].items()
        for k,v in dict_k_v:
            for wm in v:
                wm["SheetName"] = catName
            AIOdic[k] = v
    return AIOdic



def matchWith_paramDic(catSheetDic, paramSheetDic):
    headers = list(catSheetDic.values())[0][0].keys()
    wmspec_headers = list(filter(lambda x: "Work C" in x or "Spec" in x, headers))
    res = {}
    for famType,diclist in catSheetDic.items():
        new_diclist = []
        for d in diclist:
            new_d = {}
            keys = d.keys()
            keys_new = set(keys) - set(wmspec_headers)
            calcType = d["Q'ty Cal Type Tag"]
            new_d["Sym_Val Dict"] = paramSheetDic[calcType]
            new_d["wmSpecs"] = list(map(lambda x: d[x],wmspec_headers))
            for spec in keys_new:
                new_d[spec] = d[spec]
            new_diclist.append(new_d)
        
        res[famType] = new_diclist
        
    return res

calcTypeDictsList = get_DataOnRangesAtParamSheet(paramSheet)
calcTypeDict = make_UnifiedDict(calcTypeDictsList)
paramSheetDic = get_SymValDict_PerCalcType(calcTypeDict) 

catSheetDic = make_AIOdic(allCatSheets)
catFam_paramDic = matchWith_paramDic(catSheetDic, paramSheetDic)

# Assign your output to the OUT variable.

#OUT = [catFam_paramDic,paramSheetDic, catSheetDic]
OUT = catSheetDic
# ----------------------------------------
keys = DesignScript.Builtin.Dictionary.Keys(dictionary=excel_data)
values = DesignScript.Builtin.Dictionary.Values(dictionary=excel_data)
code_block_5 = CodeBlock { "SheetName"; }
valueAtKey = DesignScript.Builtin.Dictionary.ValueAtKey(dictionary=values, key=code_block_5)
uniqueItems_2 = List.UniqueItems(list=valueAtKey@L2)
flatten = List.Flatten(list=uniqueItems_2)
groupByKey = List.GroupByKey(list=keys, keys=flatten)
byKeysValues = DesignScript.Builtin.Dictionary.ByKeysValues(keys=groupByKey.uniqueKeys, values=groupByKey.groups)
uniqueItems_3 = List.UniqueItems(list=flatten)
code_block_6 = CodeBlock { "."; }
split = String.Split(string=uniqueItems_3, separator0=code_block_6)
firstItem = List.FirstItem(list=split@L2)
toNumber = String.ToNumber(string=firstItem)
sortByKey = List.SortByKey(list=uniqueItems_3, keys=toNumber)
valueAtKey_2 = DesignScript.Builtin.Dictionary.ValueAtKey(dictionary=byKeysValues, key=sortByKey.sortedList)

from_excel = CodeBlock(j=valueAtKey_2) { j; }
make_pairdictlist = Python(IN[0]=from_revit, IN[1]=from_excel)  # CPython3
# ---------- make_pairdictlist.python (19 lines) ----------
# Load the Python Standard and DesignScript Libraries
import sys
import clr
clr.AddReference('ProtoGeometry')
from Autodesk.DesignScript.Geometry import *

# The inputs to this node will be stored as a list in the IN variables.
dataEnteringNode = IN
rvtTypesGrps = IN[0]
exlTypesGrps = IN[1]
# Place your code below this line

def chk_sameTypes_byCat(rvtTypes,exlTypes):
    rvtOnly = list(filter(lambda x: x not in exlTypes, rvtTypes))
    both = list(filter(lambda x: x in exlTypes, rvtTypes))
    return {"RvtOnly": rvtOnly, "Both": both}

# Assign your output to the OUT variable.
OUT = map(lambda x: chk_sameTypes_byCat(*x), list(zip(rvtTypesGrps,exlTypesGrps)))
# ----------------------------------------
formatting_for_excel_old = Python(IN[0]=make_pairdictlist)  # CPython3; frozen
# ---------- formatting_for_excel_old.python (58 lines) ----------
# Load the Python Standard and DesignScript Libraries
import sys
import clr
clr.AddReference('ProtoGeometry')
from Autodesk.DesignScript.Geometry import *

# The inputs to this node will be stored as a list in the IN variables.
dataEnteringNode = IN
pairDictsList = IN[0]
# Place your code below this line

def makeTypesList(pairDictsList):
    res = []
    for catD in pairDictsList:
        if catD["Both"] == []:
            tmpBoth = list(map(lambda x: None, range(len(catD["RvtOnly"]))))
            pair = list(zip(catD["RvtOnly"], tmpBoth))
            res.append(pair)
        elif catD["RvtOnly"] == []:
            tmpRvt = list(map(lambda x: None, range(len(catD["Both"]))))
            pair = list(zip(tmpRvt, catD["Both"]))
            res.append(pair)
        else:
            if len(catD["RvtOnly"]) > len(catD["Both"]):
                cntRvt = len(catD["RvtOnly"])
                cntBoth = len(catD["Both"])
                gap = cntRvt-cntBoth
                tmpBoth = catD["Both"] + list(map(lambda x: None, range(gap)))
                pair = list(zip(catD["RvtOnly"], tmpBoth))
                res.append(pair)
            else:
                cntRvt = len(catD["RvtOnly"])
                cntBoth = len(catD["Both"])
                gap = cntBoth - cntRvt
                tmpRvt = catD["RvtOnly"] + list(map(lambda x: None, range(gap)))
                pair = list(zip(tmpRvt, catD["Both"]))
                
                res.append(pair)
        
    return res

def format_byRow(typeListGrps):
    max_cnt = max(list(map(len,typeListGrps)))
    res = []
    for grp in typeListGrps:
        if len(grp) < max_cnt:
            gap = max_cnt - len(grp)
            tmpGrp = grp + list(map(lambda x: [None,None], range(gap)))
            res.append(tmpGrp)
        else:
            res.append(grp)
    
    return list(zip(*res))


# Assign your output to the OUT variable.
#OUT = format_byRow(makeTypesList(pairDictsList))
OUT = makeTypesList(pairDictsList)
# ----------------------------------------

# group: Get PJT & Building Name
code_block_7 = CodeBlock { " - "; }
categories_2 = Categories("OST_ProjectInformation")
all_elements_of_category_2 = ElementsOfCategory(Category=categories_2)
firstItem_2 = List.FirstItem(list=all_elements_of_category_2)
code_block_8 = CodeBlock()
# ---------- code_block_8.designscript (4 lines) ----------
[
"Project Name",
"Building Name"
];
# ----------------------------------------
getParameterValueByName_3 = Element.GetParameterValueByName(element=firstItem_2, parameterName=code_block_8)
join = String.Join(separator=code_block_7, string0=getParameterValueByName_3)
firstItem_3 = List.FirstItem(list=join)

code_block_9 = CodeBlock()
# ---------- code_block_9.designscript (5 lines) ----------
[
"",
"Revit Only",
"Both Exist"
];
# ----------------------------------------
code_block_10 = CodeBlock { ""; }
code_block_11 = CodeBlock(sortedCatNames=sortByKey.sortedList) { sortedCatNames; }
addItemToEnd = List.AddItemToEnd(item=code_block_10, list=code_block_11@L1)
addItemToEnd_2 = List.AddItemToEnd(item=code_block_10, list=addItemToEnd@L2)
formatting_for_excel = Python(IN[0]=make_pairdictlist)  # CPython3
# ---------- formatting_for_excel.python (70 lines) ----------
# Load the Python Standard and DesignScript Libraries
import sys
import clr
clr.AddReference('ProtoGeometry')
from Autodesk.DesignScript.Geometry import *

# The inputs to this node will be stored as a list in the IN variables.
dataEnteringNode = IN
pairDictsList = IN[0]
# Place your code below this line

def makeTypesList(pairDictsList):
    res = []
    for catD in pairDictsList:
        if catD["Both"] == []:
            cntRvt = len(catD["RvtOnly"])
            cntBoth = len(catD["Both"])
            cntMax = max([cntRvt, cntBoth])
            tmpBoth = list(map(lambda x: "", range(len(catD["RvtOnly"]))))
            nulList = list(map(lambda x: "", range(cntMax)))
            pair = list(zip(nulList, catD["RvtOnly"], tmpBoth))
            res.append(pair)
        elif catD["RvtOnly"] == []:
            cntRvt = len(catD["RvtOnly"])
            cntBoth = len(catD["Both"])
            cntMax = max([cntRvt, cntBoth])
            tmpRvt = list(map(lambda x: "", range(len(catD["Both"]))))
            nulList = list(map(lambda x: "", range(cntMax)))
            pair = list(zip(nulList, tmpRvt, catD["Both"]))
            res.append(pair)
        else:
            if len(catD["RvtOnly"]) > len(catD["Both"]):
                cntRvt = len(catD["RvtOnly"])
                cntBoth = len(catD["Both"])
                cntMax = max([cntRvt, cntBoth])
                gap = cntRvt-cntBoth
                tmpBoth = catD["Both"] + list(map(lambda x: "", range(gap)))
                nulList = list(map(lambda x: "", range(cntMax)))
                pair = list(zip(nulList, catD["RvtOnly"], tmpBoth))
                res.append(pair)
            else:
                cntRvt = len(catD["RvtOnly"])
                cntBoth = len(catD["Both"])
                cntMax = max([cntRvt, cntBoth])
                gap = cntBoth - cntRvt
                tmpRvt = catD["RvtOnly"] + list(map(lambda x: "", range(gap)))
                nulList = list(map(lambda x: "", range(cntMax)))
                pair = list(zip(nulList, tmpRvt, catD["Both"]))
                
                res.append(pair)
        
    return res

def format_byRow(typeListGrps):
    max_cnt = max(list(map(len,typeListGrps)))
    res = []
    for grp in typeListGrps:
        if len(grp) < max_cnt:
            gap = max_cnt - len(grp)
            tmpGrp = grp + list(map(lambda x: [None,None], range(gap)))
            res.append(tmpGrp)
        else:
            res.append(grp)
    
    return list(zip(*res))


# Assign your output to the OUT variable.
#OUT = format_byRow(makeTypesList(pairDictsList))
OUT = makeTypesList(pairDictsList)
# ----------------------------------------
addItemToFront = List.AddItemToFront(item=addItemToEnd_2@L2, list=formatting_for_excel@L3)
flatten_2 = List.Flatten(list=addItemToFront@L2)
addItemToFront_2 = List.AddItemToFront(item=code_block_9, list=flatten_2)
htmlPath = Python()  # CPython3; unwired: IN[0]
# ---------- htmlPath.python (36 lines) ----------
# Load the Python Standard and DesignScript Libraries
import sys
import clr
clr.AddReference('ProtoGeometry')
from Autodesk.DesignScript.Geometry import *
import time
import subprocess
import os

clr.AddReference('RevitNodes')
import Revit
clr.ImportExtensions(Revit.Elements)
from Revit import Elements
# The inputs to this node will be stored as a list in the IN variables.
dataEnteringNode = IN

# Place your code below this line
def find_cwd():
    doc = Revit.Application.Document.Current
    filePath_string = doc.FilePath
    folderPath = filePath_string.split('\\')
    folderPath.pop(-1)
    folderPath_str = '\\'.join(folderPath)
    return folderPath_str

cwd = find_cwd()


timeStamp = time.strftime('%H_%M_%S', time.localtime(time.time()))
folderPath = f"{cwd}\\.dynLog"
if not os.path.exists(folderPath):
    os.makedirs(folderPath)
fileName = f"htmlResult_{timeStamp}.html"
filePath = f"{folderPath}\\" + fileName
# Assign your output to the OUT variable.
OUT = folderPath
# ----------------------------------------

# group: HTML Export
cssPart = Python()  # CPython3; unwired: IN[0]
# ---------- cssPart.python (34 lines) ----------
# Load the Python Standard and DesignScript Libraries
import sys
import clr
clr.AddReference('ProtoGeometry')
from Autodesk.DesignScript.Geometry import *

# The inputs to this node will be stored as a list in the IN variables.
dataEnteringNode = IN

# Place your code below this line
cssPart = '''
        table {
        border-collapse: collapse;
        width: 100%;
        }
        
        th {
        text-align: center;
        }

        th, td {
        padding: 10px;
        border-bottom: 1px solid #808080;
        }
        
        td {
        border-right: 1px solid #808080;
        }

        /* 커서 갖다대면 색깔이 바뀌며 직관적으로 표현한다 */
        tr:hover { background-color: #F5F5F5; }
'''
# Assign your output to the OUT variable.
OUT = cssPart
# ----------------------------------------
tablePart = Python(IN[0]=addItemToFront_2)  # CPython3
# ---------- tablePart.python (41 lines) ----------
# Load the Python Standard and DesignScript Libraries
import sys
import clr
clr.AddReference('ProtoGeometry')
from Autodesk.DesignScript.Geometry import *

# The inputs to this node will be stored as a list in the IN variables.
dataEnteringNode = IN
rows = IN[0]
hdr = rows[0]
# Place your code below this line
def make_th(hdr):
    preStr = "<tr>"
    postStr = "</tr>"
    hdrStrs = list(map(lambda x: f"<th>{x}</th>", hdr))
    res = "\n".join([preStr]+hdrStrs+[postStr])
    return res

def make_tr(row):
    preStr = "<tr>"
    postStr = "</tr>"
    if row[0] != "":
        rowStrs = list(map(lambda x: f"<th>{x}</th>", row))
    else:
        rowStrs = list(map(lambda x: f"<td>{x}</td>", row))
    res = "\n".join([preStr]+rowStrs+[postStr])
    return res

def make_trs(rows):
    rowsWithoutHdr = rows[1:]
    rowsStrs = list(map(make_tr, rowsWithoutHdr))
    res = "\n".join(rowsStrs)
    return res

def make_wholeTable(th,trs):
    preStr = "<table>"
    postStr = "</table>"
    res = "\n".join([preStr, th, trs, postStr])
    return res
# Assign your output to the OUT variable.
OUT = make_wholeTable(make_th(hdr), make_trs(rows))
# ----------------------------------------
make_htmlStr = Python(IN[0]=firstItem_3, IN[1]=cssPart, IN[2]=tablePart, IN[3]=htmlPath)  # CPython3
# ---------- make_htmlStr.python (41 lines) ----------
# Load the Python Standard and DesignScript Libraries
import sys
import clr
clr.AddReference('ProtoGeometry')
from Autodesk.DesignScript.Geometry import *

# The inputs to this node will be stored as a list in the IN variables.
dataEnteringNode = IN
pjt_bdName = IN[0]
cssPart = IN[1]
tablePart = IN[2]
folderPath = IN[3]

# Place your code below this line
htmlStr = f'''
<!DOCTYPE html>
<html lang="ko">

<head>
	<meta charset="UTF-8">
	<title>Family Types Check Result</title>
	<style>
        {cssPart}
	</style>
</head>

<body>
    <h3>Family Types Check Result - Revit & Excel</h3>
    <h5>Project/Building Information : {pjt_bdName}</h5>
    <h5>Check Result Path : </h5>
    <p><blockquote>{folderPath}</blockquote></p>
    
    <div>
    {tablePart}
    </div>
</body>

</html>
'''
# Assign your output to the OUT variable.
OUT = htmlStr
# ----------------------------------------
create_html_file_and_open = Python(IN[0]=make_htmlStr, IN[1]=htmlPath)  # CPython3
# ---------- create_html_file_and_open.python (78 lines) ----------
# Load the Python Standard and DesignScript Libraries
import os
import sys
import clr
clr.AddReference('ProtoGeometry')
from Autodesk.DesignScript.Geometry import *

clr.AddReference('RevitNodes')
import Revit
clr.ImportExtensions(Revit.Elements)
from Revit import Elements

import time
import subprocess

#################################Module For Functional Programing#############################################
from functools import reduce
curry = lambda f: lambda a,*args: f(a, *args) if (len(args)) else lambda *args: f(a, *args)

filter = curry(filter)
map = curry(map)

def _take(length, iter):
    res = []
    for a in iter:
        res.append(a)
        if len(res) == length:
            return res
        
take = curry(_take)
reduce = curry(reduce)

go = lambda *args: reduce(lambda a,f: f(a), args) ## 함수도 축약 가능 ##
##############################################################################################################

# The inputs to this node will be stored as a list in the IN variables.
dataEnteringNode = IN
contents = IN[0]
folderPath = IN[1]
# Place your code below this line
def find_cwd():
    doc = Revit.Application.Document.Current
    filePath_string = doc.FilePath
    folderPath = filePath_string.split('\\')
    folderPath.pop(-1)
    folderPath_str = '\\'.join(folderPath)
    return folderPath_str

#cwd = find_cwd()
cwd = folderPath

def make_resultHTMLname(htmlStr,title,cwd):
    timeStamp = time.strftime('%H_%M_%S', time.localtime(time.time()))
    #folderPath = f"{cwd}\\.dynLog"
    folderPath = cwd
    if not os.path.exists(folderPath):
        os.makedirs(folderPath)
    fileName = f"FamilyTypes Check Result_{timeStamp}.html"
    filePath = f"{folderPath}\\" + fileName
    f = open(filePath, 'w', encoding='utf8')
    f.write(htmlStr)
    f.close()
    return fileName

def execute_file(fileName):
    #cwd = find_cwd()
    folderPath = cwd
    os.chdir(folderPath)
    subprocess.run(args=[fileName], shell=True)
    

fileName = make_resultHTMLname(contents,"test3",cwd)

result = execute_file(fileName)

#subprocess.run(args=["aaa.html"], shell=True)
# Assign your output to the OUT variable.
OUT = fileName.split('.')[0]
# ----------------------------------------

# group: Excel Export
make_resultFilePath = Python(IN[0]=create_html_file_and_open)  # CPython3; frozen
# ---------- make_resultFilePath.python (64 lines) ----------
# Load the Python Standard and DesignScript Libraries
import os
import sys
import clr
clr.AddReference('ProtoGeometry')
from Autodesk.DesignScript.Geometry import *

clr.AddReference('RevitNodes')
import Revit
clr.ImportExtensions(Revit.Elements)
from Revit import Elements

import time
import subprocess

#################################Module For Functional Programing#############################################
from functools import reduce
curry = lambda f: lambda a,*args: f(a, *args) if (len(args)) else lambda *args: f(a, *args)

filter = curry(filter)
map = curry(map)

def _take(length, iter):
    res = []
    for a in iter:
        res.append(a)
        if len(res) == length:
            return res
        
take = curry(_take)
reduce = curry(reduce)

go = lambda *args: reduce(lambda a,f: f(a), args) ## 함수도 축약 가능 ##
##############################################################################################################

# The inputs to this node will be stored as a list in the IN variables.
dataEnteringNode = IN
title = IN[0]
# Place your code below this line
def find_cwd():
    doc = Revit.Application.Document.Current
    filePath_string = doc.FilePath
    folderPath = filePath_string.split('\\')
    folderPath.pop(-1)
    folderPath_str = '\\'.join(folderPath)
    return folderPath_str

cwd = find_cwd()

def make_resultFilePath(title,cwd):
    folderPath = f"{cwd}\\.dynLog"
    if not os.path.exists(folderPath):
        os.makedirs(folderPath)
    filePath = f"{folderPath}\\{title}.xlsx"

    return filePath



result = make_resultFilePath(title, cwd)

#subprocess.run(args=["aaa.html"], shell=True)
# Assign your output to the OUT variable.
OUT = result
# ----------------------------------------
code_block_12 = CodeBlock { "Sheet1"; }
code_block_13 = CodeBlock { 3; 1; }
exportToExcel = Data.ExportToExcel(filePath=make_resultFilePath, sheetName=code_block_12, startRow=code_block_13.out0, startColumn=code_block_13.out1, data=addItemToFront_2)  # graph output

code_block_14 = CodeBlock { ["","",""]; }
addItemToFront_3 = List.AddItemToFront(item=code_block_14, list=addItemToFront@L3)
