# Dynamo graph &&_General_Elements Join Order Organizer_1.0.1.dyn (Dynamo 2.16.1.2727)
# author: MK Jang
# Organize all elements join order

categories = Categories("OST_StructuralFoundation")
all_elements_of_category = ElementsOfCategory(Category=categories)
categories_2 = Categories("OST_StructuralColumns")
all_elements_of_category_2 = ElementsOfCategory(Category=categories_2)
name = Family.Name(family=all_elements_of_category_2)
code_block = CodeBlock { "_ASC_"; }
contains = String.Contains(string=name, searchFor=code_block)
filterByBoolMask = List.FilterByBoolMask(list=all_elements_of_category_2, mask=contains)
categories_3 = Categories("OST_StructuralFraming")
all_elements_of_category_3 = ElementsOfCategory(Category=categories_3)
name_2 = Family.Name(family=all_elements_of_category_3)
code_block_2 = CodeBlock { "_ASB_"; }
contains_2 = String.Contains(string=name_2, searchFor=code_block_2)
filterByBoolMask_2 = List.FilterByBoolMask(list=all_elements_of_category_3, mask=contains_2)
categories_4 = Categories("OST_Walls")
all_elements_of_category_4 = ElementsOfCategory(Category=categories_4)
categories_5 = Categories("OST_Floors")
all_elements_of_category_5 = ElementsOfCategory(Category=categories_5)
categories_6 = Categories("OST_Roofs")
all_elements_of_category_6 = ElementsOfCategory(Category=categories_6)
custom_selection = CustomSelection("All at Once", items={All at Once: ",0,1,2,3,4,5,6,7", 1. Fdn & Peds: ",0,1", 2. Peds & AG Columns: ",1,2", 3. Columns & Beams: ",3,4", 4. Columns & Floors: ",3,6", 5. Columns & Walls: ",3,5", 6. Columns & Roofs: ",7,3", 7. Beams & Floors: ",6,4", 8. Beams & Walls: ",4,5", 9. Beams & Roofs: ",7,4", 10. Walls & Floors: ",5,6", 11. Walls & Roofs: ",7,5"})  # graph input
python_script = Python(IN[0]=all_elements_of_category, IN[1]=filterByBoolMask.out, IN[2]=filterByBoolMask_2.out, IN[3]=all_elements_of_category_4, IN[4]=all_elements_of_category_5, IN[5]=all_elements_of_category_6, IN[6]=custom_selection)  # CPython3; frozen
# ---------- python_script.python (183 lines) ----------
# Load the Python Standard and DesignScript Libraries
import sys
import clr
clr.AddReference('ProtoGeometry')
from Autodesk.DesignScript.Geometry import *

clr.AddReference('RevitNodes')
import Revit
clr.ImportExtensions(Revit.Elements)
from Revit import Elements

import os
import time

#################################Module For Functional Programing#############################################
from functools import reduce
curry = lambda f: lambda a,*args: f(a, *args) if (len(args)) else lambda *args: f(a, *args)

filter = curry(filter)
map = curry(map)

def _take(length, iter):
    res = []
    for a in iter:
        res.append(a)
        if len(res) == length:
            return res
        
take = curry(_take)
reduce = curry(reduce)

go = lambda *args: reduce(lambda a,f: f(a), args) ## 함수도 축약 가능 ##
##############################################################################################################
def find_cwd():
    doc = Revit.Application.Document.Current
    filePath_string = doc.FilePath
    folderPath = filePath_string.split('\\')
    folderPath.pop(-1)
    folderPath_str = '\\'.join(folderPath)
    return folderPath_str
    
# The inputs to this node will be stored as a list in the IN variables.
dataEnteringNode = IN
joinMode = list(map(lambda x: int(x), filter(lambda x: x!="",IN[6].split(','))))

fdns = IN[0]
#columns = IN[1]
columns = list(map(lambda x: x.SetParameterByName("Column Style",0), IN[1]))
ag_columns = \
    list(filter(lambda x: "UG" not in str(x.GetParameterValueByName("Type")), columns))
ug_columns = \
    list(filter(lambda x: "UG" in str(x.GetParameterValueByName("Type")), columns))
beams = IN[2]
walls = IN[3]
floors = IN[4]
roofs = IN[5]

cwd = find_cwd()

catsList = [
    fdns,ug_columns,ag_columns,
    columns,beams,walls,
    floors,roofs,
]

targetCats = list(map(lambda x: catsList[x], joinMode))
# Place your code below this line
def make_elementJoinLog_stt(title,cwd):
    folderPath = f"{cwd}\\.dynLog"
    if not os.path.exists(folderPath):
        os.makedirs(folderPath)
    f = open(f"{folderPath}\\Element Join log_{title}.txt", 'a')
    timeStamp = time.strftime('%Y-%m-%d | %H:%M:%S', time.localtime(time.time()))
    f.write('Stt  :::'+timeStamp+'::: \n')
    f.close()

def make_elementJoinLog(lst,title,cwd):
    folderPath = f"{cwd}\\.dynLog"
    if not os.path.exists(folderPath):
        os.makedirs(folderPath)
    f = open(f"{folderPath}\\Element Join log_{title}.txt", 'a')
    timeStamp = time.strftime('%Y-%m-%d | %H:%M:%S', time.localtime(time.time()))
    f.write('End :::'+timeStamp+'::: \n')
    for i in lst:
        f.write(i+'\n')
    f.close()

def set_joinOrder(cat1,cat2,title):
    make_elementJoinLog_stt(title,cwd)
    res = []
    for i in cat1:
        for j in cat2:
            a = "_".join(i.GetParameterValueByName("Type").GetParameterValueByName("Type Name").split('_')[3:])
            b = "_".join(j.GetParameterValueByName("Type").GetParameterValueByName("Type Name").split('_')[3:])
            if i.AreJoined(j):
                Elements.Element.SetGeometryJoinOrder(i,j)
                resStr = f"[{a}, {b}] - join order complete!"
                res.append(resStr)
            else:
                try:
                    i.JoinGeometry(j)
                    Elements.Element.SetGeometryJoinOrder(i,j)
                    resStr = f"[{a}, {b}] - newely joined and order complete!"
                    res.append(resStr)
                except:
                    resStr = f"[{a}, {b}] - nothing happened!"
                    res.append(resStr)
    make_elementJoinLog(res,title,cwd)
    return res


def set_columnJoinOrder(cat1,title):
    make_elementJoinLog_stt(title,cwd)
    res = []
    for i in cat1:
        for j in cat1:
            a = "_".join(i.GetParameterValueByName("Type").GetParameterValueByName("Type Name").split('_')[3:])
            b = "_".join(j.GetParameterValueByName("Type").GetParameterValueByName("Type Name").split('_')[3:])
            mark_a = i.GetParameterValueByName("Column Location Mark")
            mark_b = j.GetParameterValueByName("Column Location Mark")
            if i == j:
                pass
            elif mark_a == mark_b:
                if i.AreJoined(j):
                    Elements.Element.SetGeometryJoinOrder(i,j)
                    resStr = f"[{a}, {b}] - join order complete!"
                    res.append(resStr)
                else:
                    try:
                        i.JoinGeometry(j)
                        Elements.Element.SetGeometryJoinOrder(i,j)
                        resStr = f"[{a}, {b}] - newely joined and order complete!"
                        res.append(resStr)
                    except:
                        resStr = f"[{a}, {b}] - nothing happened!"
                        res.append(resStr)
    make_elementJoinLog(res,title,cwd)
    return res

def set_joinBySelection(targetCats,joinMode,cwd):
    catsNameList = [
    "Fdns",
    "Ug Cols",
    "Ag Cols",
    "Cols",
    "Beams",
    "Walls",
    "Floors",
    "Roofs",
    ]
    title = list(map(lambda x: catsNameList[x], joinMode))
    if len(title) == 2:
        title_str = ' & '.join(title)
        [cat1,cat2] = [*targetCats]
        res = set_joinOrder(cat1,cat2,title_str)
    elif title == ["Ug Cols", "Ag Cols"]:
        title_str = ' & '.join(title)
        cat1 = columns
        res = set_columnJoinOrder(cat1,title_str)
    elif len(title) == 8:
        res = [
            set_joinOrder(fdns,ug_columns,"Fdns & Ug Cols"),
            set_columnJoinOrder(columns,"Ug Cols & Ag Cols"),
            #set_joinOrder(ug_columns,ag_columns,"Ug Cols & Ag Cols"),
            set_joinOrder(columns,beams,"Cols & Beams"),
            set_joinOrder(columns,floors,"Cols & Floors"),
            set_joinOrder(columns,walls,"Cols & Walls"),
            set_joinOrder(roofs,columns,"Cols & Roofs"),
            set_joinOrder(floors,beams,"Floors & Beams"),
            set_joinOrder(beams,walls,"Beams & Walls"),
            set_joinOrder(roofs,beams,"Beams & Roofs"),
            set_joinOrder(walls,floors,"Walls & Floors"),
            set_joinOrder(roofs,walls,"Walls & Roofs"),
            ]
    
    return res


result = set_joinBySelection(targetCats,joinMode,cwd)
# Assign your output to the OUT variable.


OUT = result
# ----------------------------------------
watch = Watch(python_script)  # graph output
join = List.Join(list0=categories, list1=categories_2, list2=categories_3, list3=categories_4, list4=categories_5, list5=categories_6)
getIntersectingElementsOfCategory = Element.GetIntersectingElementsOfCategory(element=all_elements_of_category_2, category=join@@L1)
getIntersectingElementsOfCategory_2 = Element.GetIntersectingElementsOfCategory(element=all_elements_of_category_3, category=join@@L1)
getIntersectingElementsOfCategory_3 = Element.GetIntersectingElementsOfCategory(element=all_elements_of_category_4, category=join@@L1)
getIntersectingElementsOfCategory_4 = Element.GetIntersectingElementsOfCategory(element=all_elements_of_category_5, category=join@@L1)
getIntersectingElementsOfCategory_5 = Element.GetIntersectingElementsOfCategory(element=all_elements_of_category_6, category=join@@L1)
set_joinOrder = Python(IN[0]=join, IN[1]=all_elements_of_category, IN[2]=filterByBoolMask.out, IN[3]=filterByBoolMask_2.out, IN[4]=all_elements_of_category_4, IN[5]=all_elements_of_category_5, IN[6]=all_elements_of_category_6, IN[7]=custom_selection)  # CPython3
# ---------- set_joinOrder.python (204 lines) ----------
# Load the Python Standard and DesignScript Libraries
import sys
import clr
clr.AddReference('ProtoGeometry')
from Autodesk.DesignScript.Geometry import *

clr.AddReference('RevitNodes')
import Revit
clr.ImportExtensions(Revit.Elements)
from Revit import Elements

import os
import time

#################################Module For Functional Programing#############################################
from functools import reduce
curry = lambda f: lambda a,*args: f(a, *args) if (len(args)) else lambda *args: f(a, *args)

filter = curry(filter)
map = curry(map)

def _take(length, iter):
    res = []
    for a in iter:
        res.append(a)
        if len(res) == length:
            return res
        
take = curry(_take)
reduce = curry(reduce)

go = lambda *args: reduce(lambda a,f: f(a), args) ## 함수도 축약 가능 ##
##############################################################################################################
def find_cwd():
    doc = Revit.Application.Document.Current
    filePath_string = doc.FilePath
    folderPath = filePath_string.split('\\')
    folderPath.pop(-1)
    folderPath_str = '\\'.join(folderPath)
    return folderPath_str
    
# The inputs to this node will be stored as a list in the IN variables.
dataEnteringNode = IN
catslist = IN[0]
joinMode = list(map(lambda x: int(x), filter(lambda x: x!="",IN[7].split(','))))

fdns = IN[1]
#columns = IN[1]
columns = list(map(lambda x: x.SetParameterByName("Column Style",0), IN[2]))
ag_columns = \
    list(filter(lambda x: "UG" not in str(x.GetParameterValueByName("Type")), columns))
ug_columns = \
    list(filter(lambda x: "UG" in str(x.GetParameterValueByName("Type")), columns))
frames = IN[3]
walls = IN[4]
floors = IN[5]
roofs = IN[6]

cwd = find_cwd()

[
    fdnCat, columnCat,
    frameCat,wallCat,
    floorCat,roofCat,
] = catslist

catsElemsList = [
    fdns,columns,
    frames,walls,
    floors,roofs,
]
#map(f,col)

# Place your code below this line

def set_FdnJoinOrder(fdns,catslist):
    tgts = fdns
    
    intsctElems = list(map(lambda y: map(lambda x: x.GetIntersectingElementsOfCategory(y),fdns),catslist))
    [intsct_fdns, intsct_cols, intsct_frames, intsct_walls, intsct_floors, intsct_roofs] = intsctElems
    res = []
    
    def set_join_innerFunc(tgts, intsctCatElems):
        res = []
        for i in tgts:
#            if intsctCatElems == []:
#                pass
#            else:
            for j in intsctCatElems:
                #res.append(j)
                if len(j) == 0:
                    resStr = "nothing happened!"
                    res.append(resStr)
#                elif i.AreJoined(j):
#                    Elements.Element.SetGeometryJoinOrder(i,j)
#                    resStr = "join order complete!"
#                    res.append(resStr)
                else:
                    try:
                        i.JoinGeometry(j)
                        Elements.Element.SetGeometryJoinOrder(i,j)
                        resStr = "newely joined and order complete!"
                        res.append(resStr)
                    except:
                        resStr = "nothing happened!"
                        res.append(resStr)
        return res
    res=[
        set_join_innerFunc(fdns,intsct_fdns),
        set_join_innerFunc(fdns,intsct_cols),
        set_join_innerFunc(fdns,intsct_frames),
        set_join_innerFunc(fdns,intsct_walls),
        set_join_innerFunc(fdns,intsct_floors),
        ]
    
    return res

def set_colJoinOrder(columns,catslist):
    tgts = columns
    
    intsctElems = list(map(lambda y: map(lambda x: x.GetIntersectingElementsOfCategory(y),fdns),catslist))
    [intsct_fdns, intsct_cols, intsct_frames, intsct_walls, intsct_floors, intsct_roofs] = intsctElems
    res = []
    
    def set_join_innerFunc(tgts, intsctCatElems):
        res = []
        for i in tgts:
#            if intsctCatElems == []:
#                pass
#            else:
            for j in intsctCatElems:
                #res.append(j)
                if len(j) == 0:
                    resStr = "nothing happened!"
                    res.append(resStr)
#                elif i.AreJoined(j):
#                    Elements.Element.SetGeometryJoinOrder(i,j)
#                    resStr = "join order complete!"
#                    res.append(resStr)
                else:
                    try:
                        i.JoinGeometry(j)
                        Elements.Element.SetGeometryJoinOrder(i,j)
                        resStr = "newely joined and order complete!"
                        res.append(resStr)
                    except:
                        resStr = "nothing happened!"
                        res.append(resStr)
        return res
    res=[
        set_join_innerFunc(tgts,intsct_cols),
        set_join_innerFunc(tgts,intsct_frames),
        set_join_innerFunc(tgts,intsct_walls),
        set_join_innerFunc(tgts,intsct_floors),
        
        ]
    
    return res


def set_joinBySelection(targetCats,joinMode,cwd):
    catsNameList = [
    "Fdns",
    "Ug Cols",
    "Ag Cols",
    "Cols",
    "Beams",
    "Walls",
    "Floors",
    "Roofs",
    ]
    title = list(map(lambda x: catsNameList[x], joinMode))
    if len(title) == 2:
        title_str = ' & '.join(title)
        [cat1,cat2] = [*targetCats]
        res = set_joinOrder(cat1,cat2,title_str)
    elif title == ["Ug Cols", "Ag Cols"]:
        title_str = ' & '.join(title)
        cat1 = columns
        res = set_columnJoinOrder(cat1,title_str)
    elif len(title) == 8:
        res = [
            set_joinOrder(fdns,ug_columns,"Fdns & Ug Cols"),
            set_columnJoinOrder(columns,"Ug Cols & Ag Cols"),
            #set_joinOrder(ug_columns,ag_columns,"Ug Cols & Ag Cols"),
            set_joinOrder(columns,beams,"Cols & Beams"),
            set_joinOrder(columns,floors,"Cols & Floors"),
            set_joinOrder(columns,walls,"Cols & Walls"),
            set_joinOrder(roofs,columns,"Cols & Roofs"),
            set_joinOrder(floors,beams,"Floors & Beams"),
            set_joinOrder(beams,walls,"Beams & Walls"),
            set_joinOrder(roofs,beams,"Beams & Roofs"),
            set_joinOrder(walls,floors,"Walls & Floors"),
            set_joinOrder(roofs,walls,"Walls & Roofs"),
            ]
    
    return res


#result = set_joinBySelection(targetCats,joinMode,cwd)
# Assign your output to the OUT variable.


OUT = set_colJoinOrder(columns,catslist)
# ----------------------------------------
getIntersectingElementsOfCategory_6 = Element.GetIntersectingElementsOfCategory(element=all_elements_of_category, category=join@@L1)
code_block_3 = CodeBlock(i=getIntersectingElementsOfCategory_6) { i[0][0]; }
code_block_4 = CodeBlock(i=code_block_3) { i==[]; }
