# Dynamo graph Dyn_HTML template_1.0.0.dyn (Dynamo 2.16.1.2727)
# author: MK Jang
# Check Revit and Excel's Family Types

# group: HTML Export
javascriptPart = Python()  # CPython3; unwired: IN[0]
# ---------- javascriptPart.python (137 lines) ----------
# Load the Python Standard and DesignScript Libraries
import sys
import clr
clr.AddReference('ProtoGeometry')
from Autodesk.DesignScript.Geometry import *

# The inputs to this node will be stored as a list in the IN variables.
dataEnteringNode = IN

# Place your code below this line
jsPart = '''

import * as THREE from "https://unpkg.com/three@0.126.1/build/three.module.js";

// Scene
const scene = new THREE.Scene();
//size
const sizes = {
  width: window.innerWidth,
  height: window.innerHeight,
};
//camera
const camera = new THREE.PerspectiveCamera(
  75,
  sizes.width / sizes.height,
  0.1,
  100
);
camera.position.z = 2;
scene.add(camera);
//renderer
const renderer = new THREE.WebGLRenderer({
  antialias: true,
});
renderer.setSize(sizes.width, sizes.height);
renderer.setPixelRatio(Math.min(window.devicePixelRatio, 2));
renderer.setClearColor(new THREE.Color("#21282a"), 1);
document.body.appendChild(renderer.domElement);

window.addEventListener("resize", () => {
  // Update sizes
  sizes.width = window.innerWidth;
  sizes.height = window.innerHeight;

  // Update camera
  camera.aspect = sizes.width / sizes.height;
  camera.updateProjectionMatrix();

  // Update renderer
  renderer.setSize(sizes.width, sizes.height);
  renderer.setPixelRatio(Math.min(window.devicePixelRatio, 2));
});
// Objects
// sphere
const geometry = new THREE.TorusGeometry(0.7, 0.2, 16, 100);
const material = new THREE.PointsMaterial({
  size: 0.005,
  color: 0x87a7ca,
});
const sphere = new THREE.Points(geometry, material);
scene.add(sphere);

//particle
const particlesGeometry = new THREE.BufferGeometry();
const loader = new THREE.TextureLoader();
let canvas = document.createElement("canvas");
let ctx = canvas.getContext("2d");
canvas.height = 100;
canvas.width = 100;
ctx.fillStyle = "#fff";
ctx.beginPath();
ctx.arc(50, 50, 25, 0, 2 * Math.PI);
ctx.fill();
let img = canvas.toDataURL("image/png");
const star = loader.load(img);
const particlesmaterial = new THREE.PointsMaterial({
  size: 0.01,
  map: star,
  transparent: true,
});
const particlesCnt = 2000;
const posArray = new Float32Array(particlesCnt * 3);
// xyz,xyz,xyz , xyz
for (let i = 0; i < particlesCnt * 3; i++) {
  //posArray[i] = Math.random()
  //   posArray[i] = Math.random() - 0.5
  //   posArray[i] = (Math.random() - 0.5) * 5
  posArray[i] = (Math.random() - 0.5) * (Math.random() * 5);
}

particlesGeometry.setAttribute(
  "position",
  new THREE.BufferAttribute(posArray, 3)
);

const particlesMesh = new THREE.Points(particlesGeometry, particlesmaterial);
scene.add(particlesMesh);

//mouse
document.addEventListener("mousemove", animateParticles);

let mouseX = 0;
let mouseY = 0;

function animateParticles(event) {
  mouseY = event.clientY;
  mouseX = event.clientX;
}

/**
 * Animate
 */

const clock = new THREE.Clock();

const animate = () => {
  window.requestAnimationFrame(animate);

  const elapsedTime = clock.getElapsedTime();
  // Update objects
  sphere.rotation.y = 0.5 * elapsedTime;
  particlesMesh.rotation.y = -1 * (elapsedTime * 0.1);

  if (mouseX > 0) {
    particlesMesh.rotation.x = -mouseY * (elapsedTime * 0.00008);
    particlesMesh.rotation.y = -mouseX * (elapsedTime * 0.00008);
  }

  renderer.render(scene, camera);
};

animate();


'''
# Assign your output to the OUT variable.
OUT = jsPart
# ----------------------------------------
cssPart = Python()  # CPython3; unwired: IN[0]
# ---------- cssPart.python (17 lines) ----------
# Load the Python Standard and DesignScript Libraries
import sys
import clr
clr.AddReference('ProtoGeometry')
from Autodesk.DesignScript.Geometry import *

# The inputs to this node will be stored as a list in the IN variables.
dataEnteringNode = IN

# Place your code below this line
cssPart = '''
body { margin: 0; }
canvas { display: block; }

'''
# Assign your output to the OUT variable.
OUT = cssPart
# ----------------------------------------
tablePart = Python()  # CPython3; unwired: IN[0]
# ---------- tablePart.python (41 lines) ----------
# Load the Python Standard and DesignScript Libraries
import sys
import clr
clr.AddReference('ProtoGeometry')
from Autodesk.DesignScript.Geometry import *

# The inputs to this node will be stored as a list in the IN variables.
dataEnteringNode = IN
rows = IN[0]
#hdr = rows[0]
# Place your code below this line
def make_th(hdr):
    preStr = "<tr>"
    postStr = "</tr>"
    hdrStrs = list(map(lambda x: f"<th>{x}</th>", hdr))
    res = "\n".join([preStr]+hdrStrs+[postStr])
    return res

def make_tr(row):
    preStr = "<tr>"
    postStr = "</tr>"
    if row[0] != "":
        rowStrs = list(map(lambda x: f"<th>{x}</th>", row))
    else:
        rowStrs = list(map(lambda x: f"<td>{x}</td>", row))
    res = "\n".join([preStr]+rowStrs+[postStr])
    return res

def make_trs(rows):
    rowsWithoutHdr = rows[1:]
    rowsStrs = list(map(make_tr, rowsWithoutHdr))
    res = "\n".join(rowsStrs)
    return res

def make_wholeTable(th,trs):
    preStr = "<table>"
    postStr = "</table>"
    res = "\n".join([preStr, th, trs, postStr])
    return res
# Assign your output to the OUT variable.
OUT = 0#make_wholeTable(make_th(hdr), make_trs(rows))
# ----------------------------------------
make_htmlStr = Python(IN[0]=javascriptPart, IN[1]=cssPart, IN[2]=tablePart)  # CPython3
# ---------- make_htmlStr.python (40 lines) ----------
# Load the Python Standard and DesignScript Libraries
import sys
import clr
clr.AddReference('ProtoGeometry')
from Autodesk.DesignScript.Geometry import *

# The inputs to this node will be stored as a list in the IN variables.
dataEnteringNode = IN
jsPart = IN[0]
cssPart = IN[1]
tablePart = IN[2]

# Place your code below this line
##folderPath_r = folderPath.replace('\\','\\\\')

htmlStr = f'''
<!DOCTYPE html>
<html lang="ko">

<head>
    <link rel="shortcut icon" href="#">
    <meta charset="UTF-8">
    <title>my first three.js app</title>
    <style>
        {cssPart}
    </style>
</head>

<body>



<script type ="module" src="./js/script.js"></script>

</body>

</html>
'''
# Assign your output to the OUT variable.
OUT = htmlStr
# ----------------------------------------
code_block = CodeBlock(htmlStr=make_htmlStr) { htmlStr; }
htmlPath = Python()  # CPython3; unwired: IN[0]
# ---------- htmlPath.python (33 lines) ----------
# Load the Python Standard and DesignScript Libraries
import sys
import clr
clr.AddReference('ProtoGeometry')
from Autodesk.DesignScript.Geometry import *
import time
import subprocess
import os

clr.AddReference('RevitNodes')
import Revit
clr.ImportExtensions(Revit.Elements)
from Revit import Elements
# The inputs to this node will be stored as a list in the IN variables.
dataEnteringNode = IN

# Place your code below this line
def find_cwd():
    doc = Revit.Application.Document.Current
    filePath_string = doc.FilePath
    folderPath = filePath_string.split('\\')
    folderPath.pop(-1)
    folderPath_str = '\\'.join(folderPath)
    return folderPath_str

cwd = find_cwd()

folderPath = f"{cwd}\\.dynLog"
if not os.path.exists(folderPath):
    os.makedirs(folderPath)

# Assign your output to the OUT variable.
OUT = folderPath
# ----------------------------------------
create_html_file_and_open = Python(IN[0]=code_block, IN[1]=htmlPath)  # CPython3; unwired: IN[2]
# ---------- create_html_file_and_open.python (86 lines) ----------
# Load the Python Standard and DesignScript Libraries
import os
import sys
import clr
clr.AddReference('ProtoGeometry')
from Autodesk.DesignScript.Geometry import *

clr.AddReference('RevitNodes')
import Revit
clr.ImportExtensions(Revit.Elements)
from Revit import Elements

import time
import subprocess

#################################Module For Functional Programing#############################################
from functools import reduce
curry = lambda f: lambda a,*args: f(a, *args) if (len(args)) else lambda *args: f(a, *args)

filter = curry(filter)
map = curry(map)

def _take(length, iter):
    res = []
    for a in iter:
        res.append(a)
        if len(res) == length:
            return res
        
take = curry(_take)
reduce = curry(reduce)

go = lambda *args: reduce(lambda a,f: f(a), args) ## 함수도 축약 가능 ##
##############################################################################################################

# The inputs to this node will be stored as a list in the IN variables.
dataEnteringNode = IN
contents = IN[0]
folderPath = IN[1]
#bdName = IN[2]
# Place your code below this line
def find_cwd():
    doc = Revit.Application.Document.Current
    filePath_string = doc.FilePath
    folderPath = filePath_string.split('\\')
    folderPath.pop(-1)
    folderPath_str = '\\'.join(folderPath)
    return folderPath_str

#cwd = find_cwd()
cwd = folderPath

def make_resultHTMLname(htmlStr,title,cwd):
    timeStamp = time.strftime('%H_%M_%S', time.localtime(time.time()))
    #folderPath = f"{cwd}\\.dynLog"
    folderPath = cwd
    if not os.path.exists(folderPath):
        os.makedirs(folderPath)
    fileName = f"index.html"
    filePath = f"{folderPath}\\" + fileName
    f = open(filePath, 'w', encoding='utf8')
    f.write(htmlStr)
    f.close()
    return fileName


def execute_chromeIndex(cwd):
    #cwd = find_cwd()
    folderPath = cwd
    os.chdir(folderPath)
    cmdStr = "start chrome http:localhost:8000"
    cmdList= cmdStr.split(' ')
    #subprocess.run(args=[fileName], shell=True)
    #subprocess.run(args=['start','excel',fileName], shell=True)
    subprocess.run(args=cmdList, shell=True)
    return cmdList


fileName = make_resultHTMLname(contents,"test",cwd)
#fileName = "Test1.html"

#execute_file(fileName)


# Assign your output to the OUT variable.
OUT = execute_chromeIndex(cwd)#fileName.split('.')[0]
# ----------------------------------------

watch = Watch(code_block)  # graph output
create_js_file = Python(IN[0]=javascriptPart, IN[1]=htmlPath)  # CPython3; unwired: IN[2]
# ---------- create_js_file.python (84 lines) ----------
# Load the Python Standard and DesignScript Libraries
import os
import sys
import clr
clr.AddReference('ProtoGeometry')
from Autodesk.DesignScript.Geometry import *

clr.AddReference('RevitNodes')
import Revit
clr.ImportExtensions(Revit.Elements)
from Revit import Elements

import time
import subprocess

#################################Module For Functional Programing#############################################
from functools import reduce
curry = lambda f: lambda a,*args: f(a, *args) if (len(args)) else lambda *args: f(a, *args)

filter = curry(filter)
map = curry(map)

def _take(length, iter):
    res = []
    for a in iter:
        res.append(a)
        if len(res) == length:
            return res
        
take = curry(_take)
reduce = curry(reduce)

go = lambda *args: reduce(lambda a,f: f(a), args) ## 함수도 축약 가능 ##
##############################################################################################################

# The inputs to this node will be stored as a list in the IN variables.
dataEnteringNode = IN
contents = IN[0]
folderPath = IN[1]
#bdName = IN[2]
# Place your code below this line
def find_cwd():
    doc = Revit.Application.Document.Current
    filePath_string = doc.FilePath
    folderPath = filePath_string.split('\\')
    folderPath.pop(-1)
    folderPath_str = '\\'.join(folderPath)
    return folderPath_str

#cwd = find_cwd()
cwd = folderPath

def make_resultHTMLname(jsStr,cwd):
    #timeStamp = time.strftime('%H_%M_%S', time.localtime(time.time()))
    #folderPath = f"{cwd}\\.dynLog"
    folderPath = cwd
    jsPath = cwd + "\\js"
    if not os.path.exists(folderPath):
        os.makedirs(folderPath)
    if not os.path.exists(jsPath):
        os.makedirs(jsPath)
    fileName = "script.js"
    filePath = f"{jsPath}\\" + fileName
    f = open(filePath, 'w', encoding='utf8')
    f.write(jsStr)
    f.close()
    return fileName

def execute_file(fileName):
    #cwd = find_cwd()
    folderPath = cwd
    os.chdir(folderPath)
    subprocess.run(args=[fileName], shell=True)
    #subprocess.run(args=['start','excel',fileName], shell=True)
    

fileName = make_resultHTMLname(contents,cwd)
#fileName = "Test1.html"

#execute_file(fileName)


# Assign your output to the OUT variable.
OUT = fileName
# ----------------------------------------
make_htmlStr_2 = Python()  # CPython3; frozen; unwired: IN[0], IN[1], IN[2]
# ---------- make_htmlStr_2.python (39 lines) ----------
# Load the Python Standard and DesignScript Libraries
import sys
import clr
clr.AddReference('ProtoGeometry')
from Autodesk.DesignScript.Geometry import *

# The inputs to this node will be stored as a list in the IN variables.
dataEnteringNode = IN
jsPart = IN[0]
cssPart = IN[1]
tablePart = IN[2]

# Place your code below this line
##folderPath_r = folderPath.replace('\\','\\\\')

htmlStr = f'''
<!DOCTYPE html>
<html lang="ko">

<head>
    <meta charset="UTF-8">
    <title>my first three.js app</title>
    <style>
        {cssPart}
    </style>
</head>

<body>



<script type ="module" src="./js/script.js">

</body>

</html>
'''
# Assign your output to the OUT variable.
OUT = htmlStr
# ----------------------------------------
rooms_by_status = RoomsByStatus()
code_block_2 = CodeBlock(i=rooms_by_status.PlacedRooms) { i; }
parameters = Element.Parameters(element=code_block_2)
code_block_3 = CodeBlock { "Area"; }
getParameterValueByName = Element.GetParameterValueByName(element=code_block_2, parameterName=code_block_3)
code_block_4 = CodeBlock { 2; }
round = Math.Round(number=getParameterValueByName, digits=code_block_4)
code_block_5 = CodeBlock { "Number"; }
getParameterValueByName_2 = Element.GetParameterValueByName(element=code_block_2, parameterName=code_block_5)

# group: All Elements in Revit
all_elementsexceptrails = Python()  # CPython3; unwired: IN[0]
# ---------- all_elementsexceptrails.python (51 lines) ----------
# Load the Python Standard and DesignScript Libraries
import sys
import clr
clr.AddReference('ProtoGeometry')
from Autodesk.DesignScript.Geometry import *

clr.AddReference('RevitAPI')
from Autodesk.Revit.DB import *
import Autodesk

clr.AddReference('RevitServices')
import RevitServices
from RevitServices.Persistence import DocumentManager
doc = DocumentManager.Instance.CurrentDBDocument

def get_all_BIC():

    db = [
    Autodesk.Revit.DB.BuiltInCategory.OST_Floors,
    Autodesk.Revit.DB.BuiltInCategory.OST_Roofs,
    Autodesk.Revit.DB.BuiltInCategory.OST_Walls,
    Autodesk.Revit.DB.BuiltInCategory.OST_StructuralFoundation,
    Autodesk.Revit.DB.BuiltInCategory.OST_StructuralColumns,
    Autodesk.Revit.DB.BuiltInCategory.OST_StructuralFraming,
    Autodesk.Revit.DB.BuiltInCategory.OST_Ceilings,
    Autodesk.Revit.DB.BuiltInCategory.OST_Doors,
    Autodesk.Revit.DB.BuiltInCategory.OST_Windows,
    Autodesk.Revit.DB.BuiltInCategory.OST_Stairs,
    #Autodesk.Revit.DB.BuiltInCategory.OST_Railings,
    ]
    return db
    
def get_allElems(doc):
    bics = get_all_BIC()
    
    def getElems(x):
        collector = FilteredElementCollector(doc)
        res = collector.OfCategory(x).WhereElementIsNotElementType().ToElements()
        return res

    def getRailElems(x):
        collector = FilteredElementCollector(doc)
        res = collector.OfCategory(x).WhereElementIsNotElementType()
        return res

    res = map(getElems, bics)
#    res = getRailElems(Autodesk.Revit.DB.BuiltInCategory.OST_RailingSystemRail)
    return res


OUT = get_allElems(doc)
# ----------------------------------------
categories = Categories("OST_StairsRailing")
all_elements_of_category = ElementsOfCategory(Category=categories)
list_create = List.Create(item0=all_elements_of_category)
join = List.Join(list0=all_elementsexceptrails, list1=list_create)

code_block_6 = CodeBlock(i=join) { i[0]; }
parameters_2 = Element.Parameters(element=code_block_6)
uniqueId = Element.UniqueId(element=join)
make_htmlStr_3 = Python(IN[0]=javascriptPart, IN[1]=cssPart, IN[2]=tablePart)  # CPython3
# ---------- make_htmlStr_3.python (53 lines) ----------
# Load the Python Standard and DesignScript Libraries
import sys
import clr
clr.AddReference('ProtoGeometry')
from Autodesk.DesignScript.Geometry import *

# The inputs to this node will be stored as a list in the IN variables.
dataEnteringNode = IN
jsPart = IN[0]
cssPart = IN[1]
tablePart = IN[2]

# Place your code below this line
##folderPath_r = folderPath.replace('\\','\\\\')

htmlStr = f'''
<!DOCTYPE html>
<html lang="ko">

<head>
    <meta charset="UTF-8">
    <title>my first three.js app</title>
    <style>
        {cssPart}
    </style>
</head>

<body>


<div class="wrapper">

  <a data-fslightbox="gallery" href="#custom-source">
    유튜브 라이트박스
  </a>

  <iframe id="custom-source"
          frameborder="0"
          width="1920px"
          height="1080px"
          allow="autoplay; fullscreen"
          src="https://www.youtube.com/embed/qgBSiRwsbNw?autoplay=1">
  </iframe>
</div>

<script src="https://cdnjs.cloudflare.com/ajax/libs/fslightbox/3.3.1/index.min.js" integrity="sha512-EqNNJuepkw5P9vxCml8eBk7C4Ld+4kAnvzOD/jG21rkxWPILGoQa5EvD62UieiJF0u3xoQrcVnce4i83VnYj/Q==" crossorigin="anonymous" referrerpolicy="no-referrer"></script>

</body>

</html>
'''
# Assign your output to the OUT variable.
OUT = htmlStr
# ----------------------------------------
start_webserver = Python(IN[0]=htmlPath)  # CPython3
# ---------- start_webserver.python (42 lines) ----------
# Load the Python Standard and DesignScript Libraries
import sys
import clr
clr.AddReference('ProtoGeometry')
from Autodesk.DesignScript.Geometry import *

import os

import subprocess
# The inputs to this node will be stored as a list in the IN variables.
dataEnteringNode = IN
cwd = IN[0]
# Place your code below this line
batStr = """
@echo on
python -m http.server
cmd /k
"""
title = "localWebserver"

def make_startSever_bat(batStr,title,cwd):
    folderPath = cwd
    if not os.path.exists(folderPath):
        os.makedirs(folderPath)
    fileName = f"{title}.bat"
    filePath = f"{folderPath}\\" + fileName
    f = open(filePath, 'w', encoding='utf8')
    f.write(batStr)
    f.close()
    return fileName

def startBat(fileName, cwd):
    cmdStr = f".\\{fileName}"
    cmdList= cmdStr.split(' ')
    
    subprocess.run(args=cmdList, shell=True)
    return cmdList

fileName = make_startSever_bat(batStr,title,cwd)

# Assign your output to the OUT variable.
OUT = startBat(fileName, cwd)
# ----------------------------------------
