# Dynamo graph 바닥만들기+1.dyn (Dynamo 2.0.4.12684)

# group: select dwg
select_model_elements = DSModelElementsSelection()  # 1 picked in the model

code_block = CodeBlock { "DL_BR"; }
curvesFromCADLayers = CAD.CurvesFromCADLayers(importInstance=select_model_elements, layerNames=code_block)
code_block_2 = CodeBlock(list=curvesFromCADLayers.Curve) { DSCore.List.Flatten(list); }
code_block_3 = CodeBlock { 4; }
chop = List.Chop(list=code_block_2, lengths=code_block_3)
code_block_4 = CodeBlock { 20; }
byJoinedCurves = PolyCurve.ByJoinedCurves(curves=chop, joinTolerance=code_block_4)
ꟿ_closedcurve_offset = Custom[ꟿ ClosedCurve.Offset+](curve=byJoinedCurves, distance=code_block_4)  # Offsets a curve both ways and correctly differenciates the external and internal offset. If an offset goes beyond the curve's bounds, the result will fail and a null value will be appended instead. Also works for convex curves like arcs.
explode = Geometry.Explode(geometry=ꟿ_closedcurve_offset.internal_offset)
levels = Levels(index=4)
levels_2 = Levels(index=5)
wall_types = WallTypes(index=27)
byCurveAndLevels = Wall.ByCurveAndLevels(c=explode, startLevel=levels, endLevel=levels_2, wallType=wall_types)
code_block_5 = CodeBlock { "Top Constraint"; }
setParameterByName = Element.SetParameterByName(element=byCurveAndLevels, parameterName=code_block_5, value=levels_2)
code_block_6 = CodeBlock { "Base Offset"; }
code_block_7 = CodeBlock { 120; }
setParameterByName_2 = Element.SetParameterByName(element=setParameterByName, parameterName=code_block_6, value=code_block_7)
code_block_8 = CodeBlock { "Top Offset"; }
code_block_9 = CodeBlock { -210; }
setParameterByName_3 = Element.SetParameterByName(element=setParameterByName_2, parameterName=code_block_8, value=code_block_9)
flip = Custom[Wall.Flip]()  # frozen; Flips the orientation of a given wall - DO ***NOT*** USE IN AUTOMATIC MODE; unwired: wall
code_block_10 = CodeBlock { DSCore.List.Flatten(list); }  # frozen; unwired: list
XAxis = Vector.XAxis()
normal = Curve.Normal(curve=explode)
angleWithVector = Vector.AngleWithVector(vector=XAxis, otherVector=normal)
