# Dynamo graph 코리더 기준선 작업.dyn (Dynamo 2.5.0.7460)
# packages: CivilConnection2020 5.0.5

civilApplication = CivilConnection.CivilApplication.CivilApplication()
getDocuments = CivilConnection.CivilApplication.GetDocuments(civilApplication=civilApplication)
getCorridors = CivilConnection.CivilDocument.GetCorridors(civilDocument=getDocuments@L2)
baselines = CivilConnection.Corridor.Baselines(corridor=getCorridors)
baselines_2 = CivilConnection.Corridor.Baselines(corridor=baselines)
shapes = CivilConnection.BaselineRegion.Shapes(baselineRegion=baselines_2)
codes = CivilConnection.AppliedSubassemblyShape.Codes(appliedSubassemblyShape=shapes)
flatten = List.Flatten(list=codes)
file_path = Filename("C:\Users\DS\Desktop\11.dwg")
flatten_2 = List.Flatten(list=shapes)
codes_2 = CivilConnection.AppliedSubassemblyShape.Codes(appliedSubassemblyShape=flatten_2)
groupByKey = List.GroupByKey(list=flatten_2, keys=codes_2)
stations = CivilConnection.BaselineRegion.Stations(baselineRegion=baselines_2)
flatten_3 = List.Flatten(list=stations)
byShapesCreaseStations = CivilConnection.Mass.ByShapesCreaseStations(familyTemplate=file_path, name=groupByKey.unique_keys, shapes=groupByKey.groups, stations=flatten_3)
