# Dynamo graph Homes.dyn (Dynamo 2.3.1.11775)

# group: Model
all_elements_in_active_view = ElementsInView()
code_block = CodeBlock { "Codes"; }
getParameterValueByName = Element.GetParameterValueByName(element=all_elements_in_active_view, parameterName=code_block)
string_from_object = FromObject(obj=getParameterValueByName)

# group: Excel
file_path = Filename(".\샘플.xlsx")
file_from_path = FileObject(path=file_path)
code_block_2 = CodeBlock { "Sheet1"; }
importExcel = Data.ImportExcel(file=file_from_path, sheetName=code_block_2)
transpose = List.Transpose(lists=importExcel)
code_block_3 = CodeBlock(A=transpose) { A[0]; }
deconstruct = List.Deconstruct(list=code_block_3)
string_from_object_2 = FromObject(obj=deconstruct.rest)
code_block_4 = CodeBlock(A=transpose) { A[1]; }
deconstruct_2 = List.Deconstruct(list=code_block_4)

# group: 입력할 파라메터의 이름
code_block_5 = CodeBlock { "Mark"; }

# group: Phasing Codes 입력
eq = string_from_object_2@L2 == string_from_object  # lacing=CrossProduct
filterByBoolMask = List.FilterByBoolMask(list=string_from_object, mask=eq@L2)
watch = Watch(filterByBoolMask.in)
allIndicesOf = List.AllIndicesOf(list=string_from_object, item=watch)
getItemAtIndex = List.GetItemAtIndex(list=all_elements_in_active_view, index=allIndicesOf)
setParameterByName = Element.SetParameterByName(element=getItemAtIndex, parameterName=code_block_5, value=deconstruct_2.rest, lacing=CrossProduct)
flatten = List.Flatten(list=allIndicesOf)
flatten_2 = List.Flatten(list=watch)
