# Dynamo graph family doc parameter.dyn (Dynamo 2.12.0.5650)
# packages: Orchid 212.1.0.8171

# group: Revit 기본노드
current = Document.Current()
byDocument = FamilyDocument.ByDocument(document=current)
code_block = CodeBlock { "C"; }
code_block_2 = CodeBlock { "(A * B)/ 1mm"; }
setFormula = FamilyDocument.SetFormula(familyDocument=byDocument, parameterName=code_block, formula=code_block_2)  # frozen

# group: Orchid Package
o_document_current = Orchid.RevitProject.Common.Document.Current()
code_block_3 = CodeBlock { "C"; }
code_block_4 = CodeBlock { "(A * B)/ 1mm"; }
o_formula_set = Orchid.RevitFamily.Formula.Set(familyDocument=o_document_current, parameterName=code_block_3, value=code_block_4)  # frozen
o_about_update = Orchid.About.Update()

# group: By Python Script
code_block_5 = CodeBlock { "C"; }
code_block_6 = CodeBlock { "(A * A * B)/ (1mm * 1mm)"; }
python_script = Python(IN[0]=code_block_5, IN[1]=code_block_6)  # CPython3
# ---------- python_script.python (56 lines) ----------
# Load the Python Standard and DesignScript Libraries
import sys
import clr
clr.AddReference('ProtoGeometry')
from Autodesk.DesignScript.Geometry import *

clr.AddReference('RevitAPI')
from Autodesk.Revit.DB import *

clr.AddReference('RevitServices')
import RevitServices
from RevitServices.Persistence import DocumentManager
from RevitServices.Transactions import TransactionManager

doc = DocumentManager.Instance.CurrentDBDocument


# The inputs to this node will be stored as a list in the IN variables.
dataEnteringNode = IN
paramName = IN[0]
paramValue = IN[1]

# Place your code below this line
def setFormula(_doc, _paramName, _paramValue):
    param_list = _doc.FamilyManager.GetParameters()
    param_list_str = [x.Definition.Name for x in param_list]
    
    def chck_ValidName(_paramName):
        if _paramName in param_list_str:
            return True
        else:
            return False
            
    def find_ParamObj(_paramName):
        return param_list[param_list_str.index(_paramName)]
    
    if chck_ValidName(_paramName):
        paramObj = find_ParamObj(_paramName)
        
        TransactionManager.Instance.EnsureInTransaction(doc)
        try:
            _doc.FamilyManager.SetFormula(paramObj, _paramValue)
            
            result = f'SetFormula as "{_paramValue}"'
        except:
            result = "SetFormula failed"
        TransactionManager.Instance.TransactionTaskDone()
    else:
        result = "Failed"
    
    return result


# Assign your output to the OUT variable.

OUT = setFormula(doc, paramName, paramValue)
# ----------------------------------------

type = Object.Type(object=o_document_current)
