# Dynamo graph Home.dyn (Dynamo 2.12.0.5650)
# packages: Orchid 212.1.0.8171

o_document_current = Orchid.RevitProject.Common.Document.Current()
code_block = CodeBlock { ["ABC"]; }
code_block_2 = CodeBlock { "Length"; }
select_builtin_parameter_group = BuiltInParameterGroup("PG_GEOMETRY")
boolean = BoolSelector(true)
boolean_2 = BoolSelector(false)
o_parameter_create = Orchid.RevitFamily.Parameter.Create(familyDocument=o_document_current, parameterName=code_block, type=code_block_2, group=select_builtin_parameter_group, instance=boolean, reporting=boolean_2)
categories = Categories("OST_Mass")
o_parameter_create_2 = Orchid.RevitFamily.Parameter.Create(familyDocument=o_document_current, parameterName=code_block, category=categories, group=select_builtin_parameter_group, instance=boolean)  # frozen
select_parameter_type = ParameterType("Length")
type = Object.Type(object=select_parameter_type)
