# Dynamo graph PointDeconstruction.dyn (Dynamo 2.12.0.5650)

code_block = CodeBlock { 1; 2; 3; 4; 5; }
byCoordinates = Point.ByCoordinates(x=code_block.out0)
byCoordinates_2 = Point.ByCoordinates(x=code_block.out1)
byCoordinates_3 = Point.ByCoordinates(x=code_block.out2)
byCoordinates_4 = Point.ByCoordinates(x=code_block.out3)
byCoordinates_5 = Point.ByCoordinates(x=code_block.out4)
join = List.Join(list0=byCoordinates, list1=byCoordinates_2, list2=byCoordinates_3, list3=byCoordinates_4, list4=byCoordinates_5)
python_script = Python(IN[0]=join)  # CPython3
# ---------- python_script.python (27 lines) ----------
# Python 표준 및 DesignScript 라이브러리 로드
import sys
import clr
clr.AddReference('ProtoGeometry')
from Autodesk.DesignScript.Geometry import *

def iterize(function):
    def wrapper(args):
        if isinstance(args, list) or isinstance(args, set) or isinstance(args, tuple) or isinstance(args, dict):
            return map(wrapper, args)
        else:
            return function(args)
    return wrapper

# 이 노드에 대한 입력값은 IN 변수에 리스트로 저장됩니다.
dataEnteringNode = IN
pts = IN[0]

# 코드를 이 선 아래에 배치
@iterize
def deconstructionPoint(_pt):
    res = (_pt.X, _pt.Y, _pt.Z)
    return res


# 출력을 OUT 변수에 지정합니다.
OUT = deconstructionPoint(pts)
# ----------------------------------------
