# Dynamo graph Home.dyn (Dynamo 2.12.0.5650)
# packages: spring nodes 210.1.1

code_block = CodeBlock { 0; 1000; 4; }
byCoordinates = Point.ByCoordinates(x=code_block.out0, y=code_block.out0, z=code_block.out0)
byCenterPointRadius = Circle.ByCenterPointRadius(centerPoint=byCoordinates, radius=code_block.out1)
regularPolygon = Polygon.RegularPolygon(circle=byCenterPointRadius, numberSides=code_block.out2)
byPatch = Surface.ByPatch(closedCurve=regularPolygon)
thicken = Surface.Thicken(surface=byPatch, thickness=code_block.out1)
file_path = Filename("..\..\..\ProgramData\Autodesk\RVT 2022\Family Templates\English\Metric Generic Model.rft")
code_block_2 = CodeBlock { "Test"; "Columns"; }
byName = Category.ByName(name=code_block_2.out1)
code_block_3 = CodeBlock { "Air"; }
byName_2 = Material.ByName(name=code_block_3)
ꟿ_familyinstance_bygeometry = Custom[ꟿ FamilyInstance.ByGeometry](geometry=thicken, familyTemplatePath=file_path, familyName=code_block_2.out0, category=byName, materialName=byName_2)  # frozen; package spring nodes
code_block_4 = CodeBlock {  }
byGeometry = FamilyType.ByGeometry(solidGeometry=thicken, name=code_block_2.out0, category=byName, templatePath=file_path, material=byName_2)
code_block_5 = CodeBlock { 50000; }
byCoordinates_2 = Point.ByCoordinates(y=code_block_5)
byPoint = FamilyInstance.ByPoint(familyType=byGeometry, point=byCoordinates_2)
