# Dynamo graph [KDUG]New Opening_Duplicate(2).dyn (Dynamo 2.13.1.3887)

code_block = CodeBlock()
# ---------- code_block.designscript (4 lines) ----------
Line.ByStartPointEndPoint(Autodesk.Point.ByCoordinates(0,6000,0),Autodesk.Point.ByCoordinates(0,-6000,0));
height:double=10000;
Revit.Level.ByElevation(0);
WallType.ByName("일반 - 300mm");
# ----------------------------------------
code_block_2 = CodeBlock { Autodesk.Vector.YAxis(); 20000; }
translate = Geometry.Translate(geometry=code_block.out0, direction=code_block_2.out0, distance=code_block_2.out1)
list_create = List.Create(item0=code_block.out0, item1=translate)
byCurveAndHeight = Wall.ByCurveAndHeight(curve=list_create, height=code_block.height, level=code_block.out2, wallType=code_block.out3, lacing=Longest)

# group: 
# 불필요한 프로파일 (라인) 로 인식되는 것들이므로 벽체가 생성이 안됨.
code_block_3 = CodeBlock()
# ---------- code_block_3.designscript (4 lines) ----------
p1 = Autodesk.Point.ByCoordinates(10000,22000,5000);
p2 = Autodesk.Point.ByCoordinates(10000,22000,0);
p3 = Autodesk.Point.ByCoordinates(10000,20000,0);
p4 = Autodesk.Point.ByCoordinates(10000,20000,5000);
# ----------------------------------------
list_create_2 = List.Create(item0=code_block_3.p1, item1=code_block_3.p2, item2=code_block_3.p3, item3=code_block_3.p4)
byCornerPoints = Rectangle.ByCornerPoints(points=list_create_2)

boundingBox = Geometry.BoundingBox(geometry=byCornerPoints)
maxPoint = BoundingBox.MaxPoint(boundingBox=boundingBox)
minPoint = BoundingBox.MinPoint(boundingBox=boundingBox)
python_script = Python(IN[0]=byCurveAndHeight, IN[1]=maxPoint, IN[2]=minPoint)  # IronPython2
# ---------- python_script.python (48 lines) ----------
# Python 표준 및 DesignScript 라이브러리 로드
import clr
import sys
sys.path.append('C:\Python27\Lib')
import System
from System import Array
from System.Collections.Generic import *
clr.AddReference('ProtoGeometry')
from Autodesk.DesignScript.Geometry import *
clr.AddReference("RevitNodes")
import Revit
clr.ImportExtensions(Revit.Elements)
clr.ImportExtensions(Revit.GeometryConversion)
clr.AddReference("RevitServices")
import RevitServices
from RevitServices.Persistence import DocumentManager 
from RevitServices.Transactions import TransactionManager 

clr.AddReference("RevitAPI")
clr.AddReference("RevitAPIUI")

import Autodesk 
from Autodesk.Revit.DB import *
from Autodesk.Revit.UI import *

doc = DocumentManager.Instance.CurrentDBDocument
uiapp = DocumentManager.Instance.CurrentUIApplication 
app = uiapp.Application 
uidoc = uiapp.ActiveUIDocument

# 이 노드에 대한 입력값은 IN 변수에 리스트로 저장됩니다.
dataEnteringNode = IN

# 코드를 이 선 아래에 배치
host = UnwrapElement(IN[0])
pt1 = IN[1].ToXyz()
pt2 = IN[2].ToXyz()
openings = []

TransactionManager.Instance.EnsureInTransaction(doc)
for i in host:
	opening = doc.Create.NewOpening(i,pt1,pt2)
	openings.append(opening)
TransactionManager.Instance.TransactionTaskDone()
	
# 출력을 OUT 변수에 지정합니다.
#OUT = opening
OUT = openings
# ----------------------------------------
watch = Watch(python_script)

# group: 
# 불필요한 프로파일 (라인) 로 인식되는 것들이므로 벽체가 생성이 안됨.
code_block_4 = CodeBlock()
# ---------- code_block_4.designscript (4 lines) ----------
p1 = Autodesk.Point.ByCoordinates(10000,19000,5000);
p2 = Autodesk.Point.ByCoordinates(10000,19000,0);
p3 = Autodesk.Point.ByCoordinates(10000,17000,0);
p4 = Autodesk.Point.ByCoordinates(10000,17000,5000);
# ----------------------------------------
list_create_3 = List.Create(item0=code_block_4.p1, item1=code_block_4.p2, item2=code_block_4.p3, item3=code_block_4.p4)
byCornerPoints_2 = Rectangle.ByCornerPoints(points=list_create_3)

boundingBox_2 = Geometry.BoundingBox(geometry=byCornerPoints_2)
maxPoint_2 = BoundingBox.MaxPoint(boundingBox=boundingBox_2)
minPoint_2 = BoundingBox.MinPoint(boundingBox=boundingBox_2)
python_script_2 = Python(IN[0]=byCurveAndHeight, IN[1]=maxPoint_2, IN[2]=minPoint_2)  # IronPython2; same code as python_script
watch_2 = Watch(python_script_2)

# group: 
# 불필요한 프로파일 (라인) 로 인식되는 것들이므로 벽체가 생성이 안됨.
number_slider = DoubleSlider(8, range=2..10 step 1)
code_block_5 = CodeBlock(N=number_slider) { Autodesk.Plane.YZ(); width=4000/N; length=8000; X = 10000; y = -5000..5000..#N; z = 0; }
byWidthLength = Rectangle.ByWidthLength(plane=code_block_5.out0, width=code_block_5.width, length=code_block_5.length)
byCoordinates = Vector.ByCoordinates(x=code_block_5.X, y=code_block_5.y, z=code_block_5.z)
translate_2 = Geometry.Translate(geometry=byWidthLength, direction=byCoordinates)

boundingBox_3 = Geometry.BoundingBox(geometry=translate_2)
maxPoint_3 = BoundingBox.MaxPoint(boundingBox=boundingBox_3)
minPoint_3 = BoundingBox.MinPoint(boundingBox=boundingBox_3)
python_script_3 = Python(IN[0]=byCurveAndHeight, IN[1]=maxPoint_3, IN[2]=minPoint_3)  # IronPython2
# ---------- python_script_3.python (48 lines) ----------
# Python 표준 및 DesignScript 라이브러리 로드
import clr
import sys
sys.path.append('C:\Python27\Lib')
import System
from System import Array
from System.Collections.Generic import *
clr.AddReference('ProtoGeometry')
from Autodesk.DesignScript.Geometry import *
clr.AddReference("RevitNodes")
import Revit
clr.ImportExtensions(Revit.Elements)
clr.ImportExtensions(Revit.GeometryConversion)
clr.AddReference("RevitServices")
import RevitServices
from RevitServices.Persistence import DocumentManager 
from RevitServices.Transactions import TransactionManager 

clr.AddReference("RevitAPI")
clr.AddReference("RevitAPIUI")

import Autodesk 
from Autodesk.Revit.DB import *
from Autodesk.Revit.UI import *

doc = DocumentManager.Instance.CurrentDBDocument
uiapp = DocumentManager.Instance.CurrentUIApplication 
app = uiapp.Application 
uidoc = uiapp.ActiveUIDocument

# 이 노드에 대한 입력값은 IN 변수에 리스트로 저장됩니다.
dataEnteringNode = IN

# 코드를 이 선 아래에 배치
host = UnwrapElement(IN[0])
pt1 = list(map(lambda x: x.ToXyz(),IN[1]))
pt2 = list(map(lambda x: x.ToXyz(),IN[2]))
openings = []

TransactionManager.Instance.EnsureInTransaction(doc)
for i in host:
	opening = list(map(lambda y: map(lambda x: doc.Create.NewOpening(i,x,y),pt1), pt2))
	openings.append(opening)
TransactionManager.Instance.TransactionTaskDone()
	
# 출력을 OUT 변수에 지정합니다.
#OUT = opening
OUT = openings
# ----------------------------------------
watch_3 = Watch(python_script_3)
