# Dynamo graph [KDUG]New Opening_Duplicate.dyn (Dynamo 2.13.1.3887)
# packages: Clockwork for Dynamo 2.x 2.4.0, WombatDynamo 2.3.5

code_block = CodeBlock { Autodesk.Plane.YZ(); 10000; 10000; }
byWidthLength = Rectangle.ByWidthLength(plane=code_block.out0, width=code_block.out1, length=code_block.out2)
explode = Geometry.Explode(geometry=byWidthLength)
code_block_2 = CodeBlock { Autodesk.Vector.YAxis(); 20000; }
translate = Geometry.Translate(geometry=explode, direction=code_block_2.out0, distance=code_block_2.out1)
list_create = List.Create(item0=explode, item1=translate)
code_block_3 = CodeBlock()
# ---------- code_block_3.designscript (5 lines) ----------
wallname = "일반 - 300mm";
width =250;
familyname = "여과지벽체"+" "+[width]+"mm";
layerindex = 0;
Revit.Level.ByElevation(5000);
# ----------------------------------------
byName = WallType.ByName(name=code_block_3.wallname)
duplicate = Custom[FamilyType.Duplicate](elementType=byName, name=code_block_3.familyname)  # package Clockwork for Dynamo 2.x; Duplicates a family type
setCompoundLayerWidth = Custom[FamilyType.SetCompoundLayerWidth](familyType=duplicate, layerIndex=code_block_3.layerindex, width=code_block_3.width)  # package Clockwork for Dynamo 2.x; Sets the width of a specified compound layer of a given family type (only applies to family types that have a compound structure, e.g. walls, floors etc.).
byProfile = WombatDynamo.Wall.ByProfile(profile=list_create, wallType=setCompoundLayerWidth.familyType, level=code_block_3.out4)

# group: <2중벽>
code_block_4 = CodeBlock { Autodesk.Vector.ByCoordinates(5000,0,0); }
copyByVector = Custom[Element.CopyByVector](element=byProfile, vector=code_block_4)  # package Clockwork for Dynamo 2.x; Copies an element or a list of elements by a given vector.
list_create_2 = List.Create(item0=byProfile, item1=copyByVector)

code_block_5 = CodeBlock(left=list_create_2) { List.GetItemAtIndex(left,1); }

# group: 
# 불필요한 프로파일 (라인) 로 인식되는 것들이므로 벽체가 생성이 안됨.
code_block_6 = CodeBlock()
# ---------- code_block_6.designscript (4 lines) ----------
p1 = Autodesk.Point.ByCoordinates(10000,22000,10000);
p2 = Autodesk.Point.ByCoordinates(10000,22000,5000);
p3 = Autodesk.Point.ByCoordinates(10000,20000,5000);
p4 = Autodesk.Point.ByCoordinates(10000,20000,10000);
# ----------------------------------------
list_create_3 = List.Create(item0=code_block_6.p1, item1=code_block_6.p2, item2=code_block_6.p3, item3=code_block_6.p4)
byCornerPoints = Rectangle.ByCornerPoints(points=list_create_3)

boundingBox = Geometry.BoundingBox(geometry=byCornerPoints)
maxPoint = BoundingBox.MaxPoint(boundingBox=boundingBox)
minPoint = BoundingBox.MinPoint(boundingBox=boundingBox)
python_script = Python(IN[0]=code_block_5, IN[1]=maxPoint, IN[2]=minPoint)  # IronPython2
# ---------- python_script.python (48 lines) ----------
# Python 표준 및 DesignScript 라이브러리 로드
import clr
import sys
sys.path.append('C:\Python27\Lib')
import System
from System import Array
from System.Collections.Generic import *
clr.AddReference('ProtoGeometry')
from Autodesk.DesignScript.Geometry import *
clr.AddReference("RevitNodes")
import Revit
clr.ImportExtensions(Revit.Elements)
clr.ImportExtensions(Revit.GeometryConversion)
clr.AddReference("RevitServices")
import RevitServices
from RevitServices.Persistence import DocumentManager 
from RevitServices.Transactions import TransactionManager 

clr.AddReference("RevitAPI")
clr.AddReference("RevitAPIUI")

import Autodesk 
from Autodesk.Revit.DB import *
from Autodesk.Revit.UI import *

doc = DocumentManager.Instance.CurrentDBDocument
uiapp = DocumentManager.Instance.CurrentUIApplication 
app = uiapp.Application 
uidoc = uiapp.ActiveUIDocument

# 이 노드에 대한 입력값은 IN 변수에 리스트로 저장됩니다.
dataEnteringNode = IN

# 코드를 이 선 아래에 배치
host = UnwrapElement(IN[0])
pt1 = IN[1].ToXyz()
pt2 = IN[2].ToXyz()
openings = []

TransactionManager.Instance.EnsureInTransaction(doc)
for i in host:
	opening = doc.Create.NewOpening(i,pt1,pt2)
	openings.append(opening)
TransactionManager.Instance.TransactionTaskDone()
	
# 출력을 OUT 변수에 지정합니다.
#OUT = opening
OUT = openings
# ----------------------------------------
watch = Watch(python_script)

# group: 
# 불필요한 프로파일 (라인) 로 인식되는 것들이므로 벽체가 생성이 안됨.
code_block_7 = CodeBlock()
# ---------- code_block_7.designscript (4 lines) ----------
p1 = Autodesk.Point.ByCoordinates(10000,19000,10000);
p2 = Autodesk.Point.ByCoordinates(10000,19000,5000);
p3 = Autodesk.Point.ByCoordinates(10000,17000,5000);
p4 = Autodesk.Point.ByCoordinates(10000,17000,10000);
# ----------------------------------------
list_create_4 = List.Create(item0=code_block_7.p1, item1=code_block_7.p2, item2=code_block_7.p3, item3=code_block_7.p4)
byCornerPoints_2 = Rectangle.ByCornerPoints(points=list_create_4)

boundingBox_2 = Geometry.BoundingBox(geometry=byCornerPoints_2)
maxPoint_2 = BoundingBox.MaxPoint(boundingBox=boundingBox_2)
minPoint_2 = BoundingBox.MinPoint(boundingBox=boundingBox_2)
python_script_2 = Python(IN[0]=code_block_5, IN[1]=maxPoint_2, IN[2]=minPoint_2)  # IronPython2; same code as python_script
watch_2 = Watch(python_script_2)
code_block_8 = CodeBlock(ritgh=list_create_2) { List.GetItemAtIndex(ritgh,0); }

# group: 
# 불필요한 프로파일 (라인) 로 인식되는 것들이므로 벽체가 생성이 안됨.
number_slider = DoubleSlider(8, range=2..10 step 1)
code_block_9 = CodeBlock(N=number_slider) { Autodesk.Plane.YZ(); width=4000/N; length=8000; X = 10000; y = -5000..5000..#N; z = 10000; }
byWidthLength_2 = Rectangle.ByWidthLength(plane=code_block_9.out0, width=code_block_9.width, length=code_block_9.length)
byCoordinates = Vector.ByCoordinates(x=code_block_9.X, y=code_block_9.y, z=code_block_9.z)
translate_2 = Geometry.Translate(geometry=byWidthLength_2, direction=byCoordinates)

boundingBox_3 = Geometry.BoundingBox(geometry=translate_2)
maxPoint_3 = BoundingBox.MaxPoint(boundingBox=boundingBox_3)
minPoint_3 = BoundingBox.MinPoint(boundingBox=boundingBox_3)
python_script_3 = Python(IN[0]=code_block_8, IN[1]=maxPoint_3, IN[2]=minPoint_3)  # IronPython2; same code as python_script
watch_3 = Watch(python_script_3)
