# Dynamo graph 05-모델객체 자르기.dyn (Dynamo 2.13.1.3887)

select_model_elements = DSModelElementsSelection()  # 18 picked in the model; graph input
filter_mepcurve = Python(IN[0]=select_model_elements)  # CPython3
# ---------- filter_mepcurve.python (46 lines) ----------
import clr

clr.AddReference('RevitAPI')
from Autodesk.Revit.DB import *
from Autodesk.Revit.DB.Structure import *
from Autodesk.Revit.DB.Plumbing import *
from Autodesk.Revit.DB.Mechanical import *
from Autodesk.Revit.DB.Electrical import *


clr.AddReference('RevitAPIUI')
from Autodesk.Revit.UI import *

clr.AddReference('System')
from System.Collections.Generic import List

clr.AddReference('RevitNodes')
import Revit
clr.ImportExtensions(Revit.GeometryConversion)
clr.ImportExtensions(Revit.Elements)

clr.AddReference('RevitServices')
import RevitServices
from RevitServices.Persistence import DocumentManager
from RevitServices.Transactions import TransactionManager


def Unwrap(item):
    return UnwrapElement(item)


doc = DocumentManager.Instance.CurrentDBDocument
uidoc=DocumentManager.Instance.CurrentUIApplication.ActiveUIDocument

#Preparing input from dynamo to revit
if isinstance(IN[0], list):
    elements = [Unwrap(e) for e in IN[0]]
else:
    elements = [Unwrap(IN[0])]


#Do some action in a Transaction
TransactionManager.Instance.EnsureInTransaction(doc)

TransactionManager.Instance.TransactionTaskDone()
OUT = [e for e in elements if isinstance(e,Pipe) or isinstance(e, Duct) or isinstance(e, Conduit) or isinstance(e, CableTray)]
# ----------------------------------------
code_block = CodeBlock(elements=filter_mepcurve) { elements; }
code_block_2 = CodeBlock(mepElements=code_block) { mepElements; }
code_block_3 = CodeBlock(mepElements=code_block_2) { mepElements; }
list_create = List.Create()  # unwired: item0, item1
getLocation = Element.GetLocation(element=code_block)
categories = Categories("OST_Rooms")
current = Document.Current()
activeView = Document.ActiveView(document=current)
all_elements_of_category_in_view = ElementsOfCategoryInView(Category=categories, View=activeView)
centerBoundary = Room.CenterBoundary(room=all_elements_of_category_in_view)
byJoinedCurves = PolyCurve.ByJoinedCurves(curves=centerBoundary)
code_block_4 = CodeBlock(view=activeView) { view; }
get_level_height = Python(IN[0]=code_block_4)  # CPython3
# ---------- get_level_height.python (64 lines) ----------
import clr

clr.AddReference('RevitAPI')
from Autodesk.Revit.DB import *
from Autodesk.Revit.DB.Structure import *

clr.AddReference('RevitAPIUI')
from Autodesk.Revit.UI import *

clr.AddReference('System')
from System.Collections.Generic import List

clr.AddReference('RevitNodes')
import Revit
clr.ImportExtensions(Revit.GeometryConversion)
clr.ImportExtensions(Revit.Elements)

clr.AddReference('RevitServices')
import RevitServices
from RevitServices.Persistence import DocumentManager
from RevitServices.Transactions import TransactionManager

def Unwrap(item):
    return UnwrapElement(item)
    
def GetNearestUpperLevel(doc, level):
    height = level.Elevation
    levels = FilteredElementCollector(doc).OfClass(Level).ToElements()
    filterLevels = list(filter(lambda x : x.Elevation > height, levels))

    try:
        return sorted(filterLevels, key=lambda x:x.Elevation)[0]
    except:
        return None

def GetNearestBelowLevel(doc, level):
    height = level.Elevation
    levels = FilteredElementCollector(doc).OfClass(Level).ToElements()
    filterLevels = list(filter(lambda x : x.Elevation < height, levels))

    try:
       return sorted(filterLevels, key=lambda x:x.Elevation, reverse = True)[0]
    except:
        return None


doc = DocumentManager.Instance.CurrentDBDocument
uidoc=DocumentManager.Instance.CurrentUIApplication.ActiveUIDocument


view = Unwrap(IN[0])

unit = doc.GetUnits()
unitLength = unit.GetFormatOptions(SpecTypeId.Length).GetUnitTypeId()

level = view.GenLevel
upperLevel = GetNearestUpperLevel(doc, level)

elevation = level.Elevation
upperElevation = upperLevel.Elevation if upperLevel is not None else elevation + UnitUtils.ConvertToInternalUnits(10000, unitLength)

levelHeight = UnitUtils.ConvertFromInternalUnits((upperElevation - elevation),unitLength)

OUT = levelHeight
# ----------------------------------------
extrudeAsSolid = Curve.ExtrudeAsSolid(curve=byJoinedCurves, direction=get_level_height)
flatten = List.Flatten(list=extrudeAsSolid)
intersect = Geometry.Intersect(geometry=getLocation@L1, other=flatten)
flatten_2 = List.Flatten(list=intersect@L3)
endPoint = Curve.EndPoint(curve=flatten_2)
startPoint = Curve.StartPoint(curve=flatten_2)
combine = List.Combine(combineFunction=list_create, list0=endPoint, list1=startPoint)
flatten_3 = List.Flatten(list=combine@L3)
pruneDuplicates = Point.PruneDuplicates(points=flatten_3)
endPoint_2 = Curve.EndPoint(curve=getLocation)
startPoint_2 = Curve.StartPoint(curve=getLocation)
code_block_5 = CodeBlock(endPt=endPoint_2, startPt=startPoint_2) { endPt; startPt; }
distanceTo = Geometry.DistanceTo(geometry=pruneDuplicates, other=code_block_5.endPt)
code_block_6 = CodeBlock { 0; }
eq = Equals(x=distanceTo, y=code_block_6)
filterByBoolMask = List.FilterByBoolMask(list=pruneDuplicates, mask=eq)
distanceTo_2 = Geometry.DistanceTo(geometry=filterByBoolMask.out@L2, other=code_block_5.startPt@L1)
code_block_7 = CodeBlock { 0; }
eq_2 = Equals(x=distanceTo_2, y=code_block_7)
filterByBoolMask_2 = List.FilterByBoolMask(list=filterByBoolMask.out, mask=eq_2)
code_block_8 = CodeBlock(calcPt=filterByBoolMask_2.out) { calcPt; }
insert_union = BoolSelector(false)
code_block_9 = CodeBlock(boolUnion=insert_union) { boolUnion; }
code_block_10 = CodeBlock(boolUnion=code_block_9) { boolUnion; }
split_insert_fitting = Python(IN[0]=code_block_3, IN[1]=code_block_8, IN[2]=code_block_10)  # CPython3; frozen
# ---------- split_insert_fitting.python (127 lines) ----------
import clr

clr.AddReference('RevitAPI')
from Autodesk.Revit.DB import *
from Autodesk.Revit.DB.Structure import *
from Autodesk.Revit.DB.Plumbing import *
from Autodesk.Revit.DB.Mechanical import *
from Autodesk.Revit.DB.Electrical import *
from Autodesk.Revit.Exceptions import ArgumentException

clr.AddReference('RevitAPIUI')
from Autodesk.Revit.UI import *

clr.AddReference('System')
from System.Collections.Generic import List

clr.AddReference('RevitNodes')
import Revit
clr.ImportExtensions(Revit.GeometryConversion)
clr.ImportExtensions(Revit.Elements)

clr.AddReference('RevitServices')
import RevitServices
from RevitServices.Persistence import DocumentManager
from RevitServices.Transactions import TransactionManager

ProcessLists = lambda function, lists: [ProcessLists(function, item) if isinstance(item, list) else function(item) for item in lists]
def Unwrap(item):
    return UnwrapElement(item)
def ToXYZ(item):
    return item.ToRevitType()

def FindOpenAndCloseConnector(mepCrv, pt):
    conMan = mepCrv.ConnectorManager
    connectorList = []
    for con in conMan.Connectors:
        connectorList.append(con)
    returnVal = connectorList[0]
    for conn in conMan.Connectors:
        if not conn.IsConnected:
            if conn.Origin.DistanceTo(pt) < returnVal.Origin.DistanceTo(pt):
                returnVal = conn
    return returnVal
def BreakElectricalMepCurve(doc, conduitId, breakPoint):
    conduit = doc.GetElement(conduitId)
    location = conduit.Location.Curve
    start = location.GetEndPoint(0)
    end = location.GetEndPoint(1)
    copiedEls = ElementTransformUtils.CopyElement(doc, conduit.Id, breakPoint.Subtract(start))
    newId = copiedEls[0]
    
    AdjustMepCurve(doc.GetElement(newId), start, breakPoint, False)
    AdjustMepCurve(conduit, breakPoint, end, False);
    
    return newId

def AdjustMepCurve(mepCurve, p1, p2, disconnect):
    #if(disconnect):
    #    Disconnect(mepCurve)
    location = mepCurve.Location
    location.Curve = Line.CreateBound(p1, p2)

def SortPtByCurve(crv, ptList):
    paramList = []
    for pt in ptList:
        intersectionParameter = crv.Project(pt).Parameter
        paramList.append(intersectionParameter)
    
    return [x for _,x in sorted(zip(paramList,ptList))]


doc = DocumentManager.Instance.CurrentDBDocument
uidoc=DocumentManager.Instance.CurrentUIApplication.ActiveUIDocument

#Preparing input from dynamo to revit
if isinstance(IN[0], list):
    mepElements = [Unwrap(e) for e in IN[0]]
else:
    mepElements = [Unwrap(IN[0])]

if isinstance(IN[1], list):
    ptList = ProcessLists(ToXYZ, IN[1])
else:
    ptList = [ToXYZ(IN[1])]

boolInsertUnion = IN[2]



#Do some action in a Transaction
outVal = []
TransactionManager.Instance.EnsureInTransaction(doc)
for i, ele in enumerate(mepElements):
    breakEle = ele
    outVal.append(breakEle)
    crv = ele.Location.Curve
    sortedPtList = SortPtByCurve(crv, ptList[i])
    #for pt in ptList[i]:
    for pt in sortedPtList:
        try:
            if isinstance(breakEle, Duct):
                cutEleId = MechanicalUtils.BreakCurve(doc, breakEle.Id, pt)
            elif isinstance(breakEle, Pipe):
                cutEleId = PlumbingUtils.BreakCurve(doc, breakEle.Id, pt)
            elif isinstance(breakEle, Conduit):
                cutEleId = BreakElectricalMepCurve(doc, breakEle.Id, pt)
            elif isinstance(breakEle, CableTray):
                cutEleId = BreakElectricalMepCurve(doc, breakEle.Id, pt)
            cutEle = doc.GetElement(cutEleId)
            outVal.append(cutEle)
            con1 = FindOpenAndCloseConnector(breakEle, pt)
            con2 = FindOpenAndCloseConnector(cutEle, pt)
            
        except ArgumentException:
            outVal.append("error")

            continue
        if boolInsertUnion:
            try:
                doc.Create.NewUnionFitting(con1, con2)
            except:
                continue
            
TransactionManager.Instance.TransactionTaskDone()


OUT = outVal
# ----------------------------------------
code_block_11 = CodeBlock(split_elements=split_insert_fitting) { split_elements; }
code_block_12 = CodeBlock(split_elements=code_block_11) { split_elements; }
code_block_13 = CodeBlock(element=code_block_12) { element; }
code_block_14 = CodeBlock { "Comments"; }
code_block_15 = CodeBlock(room=all_elements_of_category_in_view) { room; }
code_block_16 = CodeBlock(room=code_block_15) { room; }
code_block_17 = CodeBlock(room=code_block_16) { room; }
name = Room.Name(room=code_block_17)
code_block_18 = CodeBlock { "-"; }
number = Room.Number(room=code_block_17)
code_block_19 = CodeBlock(a=name, b=code_block_18, c=number) { a+b+c; }
getLocation_2 = Element.GetLocation(element=split_insert_fitting)
code_block_20 = CodeBlock { 0.5; }
pointAtParameter = Curve.PointAtParameter(curve=getLocation_2, param=code_block_20)
code_block_21 = CodeBlock(view=code_block_4) { view; }
code_block_22 = CodeBlock(view=code_block_21) { view; }
code_block_23 = CodeBlock(view=code_block_22) { view; }
python_script = Python(IN[0]=code_block_23)  # CPython3
# ---------- python_script.python (40 lines) ----------
import clr

clr.AddReference('RevitAPI')
from Autodesk.Revit.DB import *
from Autodesk.Revit.DB.Structure import *

clr.AddReference('RevitAPIUI')
from Autodesk.Revit.UI import *

clr.AddReference('System')
from System.Collections.Generic import List

clr.AddReference('RevitNodes')
import Revit
clr.ImportExtensions(Revit.GeometryConversion)
clr.ImportExtensions(Revit.Elements)

clr.AddReference('RevitServices')
import RevitServices
from RevitServices.Persistence import DocumentManager
from RevitServices.Transactions import TransactionManager


def Unwrap(item):
    return UnwrapElement(item)


doc = DocumentManager.Instance.CurrentDBDocument
uidoc=DocumentManager.Instance.CurrentUIApplication.ActiveUIDocument

#Preparing input from dynamo to revit

view = Unwrap(IN[0])


#Do some action in a Transaction
TransactionManager.Instance.EnsureInTransaction(doc)

TransactionManager.Instance.TransactionTaskDone()
OUT = view.GenLevel.Elevation
# ----------------------------------------
code_block_24 = CodeBlock(p=pointAtParameter, z=python_script) { Point.ByCoordinates(p.X,p.Y,z); }
python_script_2 = Python(IN[0]=code_block_17, IN[1]=code_block_19, IN[2]=code_block_24)  # CPython3
# ---------- python_script_2.python (65 lines) ----------
import clr

clr.AddReference('RevitAPI')
from Autodesk.Revit.DB import *
from Autodesk.Revit.DB.Structure import *

clr.AddReference('RevitAPIUI')
from Autodesk.Revit.UI import *

clr.AddReference('System')
from System.Collections.Generic import List

clr.AddReference('RevitNodes')
import Revit
clr.ImportExtensions(Revit.GeometryConversion)
clr.ImportExtensions(Revit.Elements)

clr.AddReference('RevitServices')
import RevitServices
from RevitServices.Persistence import DocumentManager
from RevitServices.Transactions import TransactionManager


def Unwrap(item):
    return UnwrapElement(item)


doc = DocumentManager.Instance.CurrentDBDocument
uidoc=DocumentManager.Instance.CurrentUIApplication.ActiveUIDocument

#Preparing input from dynamo to revit
if isinstance(IN[0], list):
    rooms = [Unwrap(e) for e in IN[0]]
else:
    rooms = [Unwrap(IN[0])]

if isinstance(IN[1], list):
    roomNames = [e for e in IN[1]]
else:
    roomNames = [IN[1]]

if isinstance(IN[2], list):
    points = [e.ToRevitType() for e in IN[2]]
else:
    points = [IN[2].ToRevitType()]

#Do some action in a Transaction
TransactionManager.Instance.EnsureInTransaction(doc)

TransactionManager.Instance.TransactionTaskDone()
outVal=[]
for pt in points:
    isFound = False
    for i,room in enumerate(rooms):
        if room.IsPointInRoom(pt):
            outVal.append(roomNames[i])
            isFound = True
            continue
    if not isFound:
        outVal.append("")




OUT = outVal
# ----------------------------------------
setParameterByName = Element.SetParameterByName(element=code_block_13, parameterName=code_block_14, value=python_script_2)
split_insert_fitting_2 = Python(IN[0]=code_block_3, IN[1]=code_block_8, IN[2]=code_block_10)  # CPython3
# ---------- split_insert_fitting_2.python (130 lines) ----------
import clr

clr.AddReference('RevitAPI')
from Autodesk.Revit.DB import *
from Autodesk.Revit.DB.Structure import *
from Autodesk.Revit.DB.Plumbing import *
from Autodesk.Revit.DB.Mechanical import *
from Autodesk.Revit.DB.Electrical import *
from Autodesk.Revit.Exceptions import ArgumentException

clr.AddReference('RevitAPIUI')
from Autodesk.Revit.UI import *

clr.AddReference('System')
from System.Collections.Generic import List

clr.AddReference('RevitNodes')
import Revit
clr.ImportExtensions(Revit.GeometryConversion)
clr.ImportExtensions(Revit.Elements)

clr.AddReference('RevitServices')
import RevitServices
from RevitServices.Persistence import DocumentManager
from RevitServices.Transactions import TransactionManager

ProcessLists = lambda function, lists: [ProcessLists(function, item) if isinstance(item, list) else function(item) for item in lists]
def Unwrap(item):
    return UnwrapElement(item)
def ToXYZ(item):
    return item.ToRevitType()

def FindOpenAndCloseConnector(mepCrv, pt):
    conMan = mepCrv.ConnectorManager
    connectorList = []
    for con in conMan.Connectors:
        connectorList.append(con)
    returnVal = connectorList[0]
    for conn in conMan.Connectors:
        if not conn.IsConnected:
            if conn.Origin.DistanceTo(pt) < returnVal.Origin.DistanceTo(pt):
                returnVal = conn
    return returnVal
def BreakElectricalMepCurve(doc, conduitId, breakPoint):
    conduit = doc.GetElement(conduitId)
    location = conduit.Location.Curve
    start = location.GetEndPoint(0)
    end = location.GetEndPoint(1)
    copiedEls = ElementTransformUtils.CopyElement(doc, conduit.Id, breakPoint.Subtract(start))
    newId = copiedEls[0]
    
    intersectionParameter = location.Project(breakPoint).Parameter
    breakPoint2 = location.Evaluate(intersectionParameter + 1, False)
    
    AdjustMepCurve(doc.GetElement(newId), start, breakPoint, False)
    AdjustMepCurve(conduit, breakPoint2, end, False);
    
    return newId

def AdjustMepCurve(mepCurve, p1, p2, disconnect):
    #if(disconnect):
    #    Disconnect(mepCurve)
    location = mepCurve.Location
    location.Curve = Line.CreateBound(p1, p2)

def SortPtByCurve(crv, ptList):
    paramList = []
    for pt in ptList:
        intersectionParameter = crv.Project(pt).Parameter
        paramList.append(intersectionParameter)
    
    return [x for _,x in sorted(zip(paramList,ptList))]


doc = DocumentManager.Instance.CurrentDBDocument
uidoc=DocumentManager.Instance.CurrentUIApplication.ActiveUIDocument

#Preparing input from dynamo to revit
if isinstance(IN[0], list):
    mepElements = [Unwrap(e) for e in IN[0]]
else:
    mepElements = [Unwrap(IN[0])]

if isinstance(IN[1], list):
    ptList = ProcessLists(ToXYZ, IN[1])
else:
    ptList = [ToXYZ(IN[1])]

boolInsertUnion = IN[2]



#Do some action in a Transaction
outVal = []
TransactionManager.Instance.EnsureInTransaction(doc)
for i, ele in enumerate(mepElements):
    breakEle = ele
    outVal.append(breakEle)
    crv = ele.Location.Curve
    sortedPtList = SortPtByCurve(crv, ptList[i])
    #for pt in ptList[i]:
    for pt in sortedPtList:
        try:
            if isinstance(breakEle, Duct):
                cutEleId = MechanicalUtils.BreakCurve(doc, breakEle.Id, pt)
            elif isinstance(breakEle, Pipe):
                cutEleId = PlumbingUtils.BreakCurve(doc, breakEle.Id, pt)
            elif isinstance(breakEle, Conduit):
                cutEleId = BreakElectricalMepCurve(doc, breakEle.Id, pt)
            elif isinstance(breakEle, CableTray):
                cutEleId = BreakElectricalMepCurve(doc, breakEle.Id, pt)
            cutEle = doc.GetElement(cutEleId)
            outVal.append(cutEle)
            con1 = FindOpenAndCloseConnector(breakEle, pt)
            con2 = FindOpenAndCloseConnector(cutEle, pt)
            
        except ArgumentException:
            outVal.append("error")

            continue
        if boolInsertUnion:
            try:
                doc.Create.NewUnionFitting(con1, con2)
            except:
                continue
            
TransactionManager.Instance.TransactionTaskDone()


OUT = outVal
# ----------------------------------------
