# Dynamo graph 11.dyn "DP-Subdiv-Sweep" (Dynamo 2.13.0.3485)

# group: Version 2023.0.5
# note: Script Version

# group: Parameters
use_profile_position = BoolSelector(false)  # graph input
start_parameter = DoubleSlider(0, range=0..1 step 0.01)  # graph input
end_parameter = DoubleSlider(1, range=0..1 step 0.01)  # graph input
parallel = BoolSelector(true)  # graph input
path_spans = IntegerSlider(6, range=1..25 step 1)  # graph input
profile_spans = IntegerSlider(6, range=1..25 step 1)  # graph input

# group: Alias Input
profile_curve = SelectNode(SelectionFilter=1)  # graph input
path_curve = SelectNode(SelectionFilter=1)  # graph input

trimByParameter = Curve.TrimByParameter(curve=path_curve, startParameter=start_parameter, endParameter=end_parameter)

# group: Result for "Path Curve is master for sweep generation"
closestPointTo = Geometry.ClosestPointTo(geometry=profile_curve, other=trimByParameter)
startPoint = Curve.StartPoint(curve=trimByParameter)
byTwoPoints = Vector.ByTwoPoints(start=closestPointTo, end=startPoint)
translate = Geometry.Translate(geometry=profile_curve, direction=byTwoPoints)
bySweep = TSpline.TSplineSurface.BySweep(profile=translate, path=trimByParameter, parallel=parallel, pathSpans=path_spans, profileSpans=profile_spans)

# group: Result for "Profile Curve is master for sweep generation"
closestPointTo_2 = Geometry.ClosestPointTo(geometry=trimByParameter, other=profile_curve)
byTwoPoints_2 = Vector.ByTwoPoints(start=closestPointTo_2, end=closestPointTo)
translate_2 = Geometry.Translate(geometry=bySweep, direction=byTwoPoints_2)

# group: Create Sweep at Guide Curve location or at Profile Curve location?
if_ = If(test=use_profile_position, true=translate_2, false=bySweep)

send_to_alias = BakeNode(if_)
