# Dynamo graph Home.dyn (Dynamo 2.13.1.3887)

code_block = CodeBlock { "Default"; }
python_script = Python(IN[0]=code_block)  # CPython3
# ---------- python_script.python (26 lines) ----------
# Load the Python Standard and DesignScript Libraries
import os
import sys
import clr
clr.AddReference('ProtoGeometry')
from Autodesk.DesignScript.Geometry import *

# The inputs to this node will be stored as a list in the IN variables.
dataEnteringNode = IN

# Place your code below this line

def createFolder(directory):
    try:
        if not os.path.exists(directory):
            os.makedirs(directory)
    except OSError:
        print('Error: Creating directory.' + directory)
        
input = IN[0]

#createFolder(f'C:/Users/{input}/Desktop/TEST1')
createFolder("C:\\Users\\desktop\\TEST1")

# Assign your output to the OUT variable.
OUT = 0
# ----------------------------------------
