# Dynamo graph 221011 PIPE TYPE 바꾸기.dyn (Dynamo 2.12.0.5650)
# packages: MEPover 2020.6.2

categories = Categories("OST_PipeCurves")
all_elements_of_category = ElementsOfCategory(Category=categories)
mep_connector_info = Custom[MEP connector info](Element=all_elements_of_category)  # package MEPover; Returns location, connector info and connected elements
code_block = CodeBlock { 0; }
getItemAtIndex = List.GetItemAtIndex(list=mep_connector_info.Direction@L2, index=code_block)
Z = Vector.Z(vector=getItemAtIndex)
abs = Math.Abs(number=Z)
code_block_2 = CodeBlock { 1; }
eq = abs == code_block_2
filterByBoolMask = List.FilterByBoolMask(list=all_elements_of_category, mask=eq)
