# Dynamo graph Parameter Creator.dyn (Dynamo 2.16.1.2727)

categories = Categories("OST_Schedules")
all_elements_of_category = ElementsOfCategory(Category=categories)
code_block = CodeBlock(i=all_elements_of_category) { i[9]; }
code_block_2 = CodeBlock()
# ---------- code_block_2.designscript (9 lines) ----------
[
"Wall Style Name"
,"Wall Ref."
,"Wall Finish-In"
,"Wall Base Material-1"
,"Wall Base Material-2"
,"Wall Base Material-3"
,"Wall Finish-Ex"
];
# ----------------------------------------
categories_2 = Categories("OST_Windows")

# group: Create Parameter
param_names = CodeBlock { i; }  # unwired: i
code_block_3 = CodeBlock { "HEC_Schedule"; }
spec_types = SpecTypes("autodesk.spec:spec.string")
group_types = GroupTypes("autodesk.parameter.group:materials")
code_block_4 = CodeBlock { "True"; }
category = CodeBlock(cat=categories_2) { cat; }
createProjectParameter = Parameter.CreateProjectParameter(parameterName=param_names, groupName=code_block_3, specType=spec_types, groupType=group_types, instance=code_block_4, categoryList=category)

code_block_5 = CodeBlock()
# ---------- code_block_5.designscript (10 lines) ----------
[
"Roof Style Name"
,"Roof Ref."
,"Roof Base Material"
,"Roof Finish_1"
,"Roof Finish_2"
,"Roof Finish_3"
,"Roof Finish_4"
,"Roof Finish_5"
];
# ----------------------------------------
code_block_6 = CodeBlock()
# ---------- code_block_6.designscript (9 lines) ----------
[
""
,""
,""
,""
,""
,""
,""
];
# ----------------------------------------
code_block_7 = CodeBlock()
# ---------- code_block_7.designscript (8 lines) ----------
[
"Door Style Name"
,"Ref. Door Size"
,"Door Leaf"
,"Door Frame"
,"Vision"
,"Panic"
];
# ----------------------------------------
code_block_8 = CodeBlock()
# ---------- code_block_8.designscript (6 lines) ----------
[
"Window Style Name"
,"Ref. Window Size"
,"Glass"
,"Frame"
];
# ----------------------------------------
