# Dynamo graph roomCheck.dyn (Dynamo 2.16.1.2727)

categories = Categories("OST_Rooms")
all_elements_of_category = ElementsOfCategory(Category=categories)
geometry = Element.Geometry(element=all_elements_of_category)
categories_2 = Categories("OST_Floors")
all_elements_of_category_2 = ElementsOfCategory(Category=categories_2)
geometry_2 = Element.Geometry(element=all_elements_of_category_2)
integer_slider = IntegerSlider(5, range=0..10 step 1)
code_block = CodeBlock(j=integer_slider) { i[j]; }  # unwired: i
categories_3 = Categories("OST_StructuralFraming")
all_elements_of_category_3 = ElementsOfCategory(Category=categories_3)
geometry_3 = Element.Geometry(element=all_elements_of_category_3)
