# Dynamo graph sample_12.dyn (Dynamo 2.16.1.2727)

# note: 저층 포인트 군 추출
# note: 점생성

join = List.Join()  # unwired: list0, list1
add = _ + _  # unwired: x, y
code_block = CodeBlock { 0; }
xSpan = StringInput("5 6 5")  # graph input
code_block_2 = CodeBlock { " "; }
split = String.Split(string=xSpan, separator0=code_block_2)
# note: 문자열 분할
toNumber = String.ToNumber(string=split)
code_block_3 = CodeBlock(i=toNumber) { i * 1000; }
# note: 누적 연산
scan = ScanList(reduceFunction=add, seed=code_block, list0=code_block_3)  # "List.Scan"
ySpan = StringInput("4 6")  # graph input
code_block_4 = CodeBlock { " "; }
split_2 = String.Split(string=ySpan, separator0=code_block_4)
toNumber_2 = String.ToNumber(string=split_2)
code_block_5 = CodeBlock(i=toNumber_2) { i * 1000; }
scan_2 = ScanList(reduceFunction=add, seed=code_block, list0=code_block_5)  # "List.Scan"
cartesianProduct = List.CartesianProduct(combineFunction=join, list0=scan, list1=scan_2)

# group: x좌표 콜렉팅
# note: 좌표 조합
firstItem = List.FirstItem(list=cartesianProduct@L2)

zSpan = StringInput("3.5 4")  # graph input
code_block_6 = CodeBlock { " "; }
split_3 = String.Split(string=zSpan, separator0=code_block_6)
toNumber_3 = String.ToNumber(string=split_3)
code_block_7 = CodeBlock(i=toNumber_3) { i * 1000; }
scan_3 = ScanList(reduceFunction=add, seed=code_block, list0=code_block_7)  # "List.Scan"
count = List.Count(list=scan_3)
cycle = List.Cycle(list=firstItem@L3, amount=count)

# group: y좌표 콜렉팅
lastItem = List.LastItem(list=cartesianProduct@L2)

cycle_2 = List.Cycle(list=lastItem@L3, amount=count)
count_2 = List.Count(list=lastItem)
cycle_3 = List.Cycle(list=scan_3@L1, amount=count_2)
byCoordinates = Point.ByCoordinates(x=cycle@L2, y=cycle_2@L2, z=cycle_3@L2)
firstItem_2 = List.FirstItem(list=byCoordinates)
Y = Point.Y(point=firstItem_2)
groupByKey = List.GroupByKey(list=firstItem_2, keys=Y)
# note: x,y 좌표 기준으로 그루핑 후 그리드 레퍼런스 라인 생성
firstItem_3 = List.FirstItem(list=groupByKey.groups@L2)
lastItem_2 = List.LastItem(list=groupByKey.groups@L2)
byStartPointEndPoint = Line.ByStartPointEndPoint(startPoint=firstItem_3, endPoint=lastItem_2)
X = Point.X(point=firstItem_2)
groupByKey_2 = List.GroupByKey(list=firstItem_2, keys=X)
firstItem_4 = List.FirstItem(list=groupByKey_2.groups@L2)
lastItem_3 = List.LastItem(list=groupByKey_2.groups@L2)
byStartPointEndPoint_2 = Line.ByStartPointEndPoint(startPoint=firstItem_4, endPoint=lastItem_3)
list_create = List.Create(item0=byStartPointEndPoint, item1=byStartPointEndPoint_2)
code_block_8 = CodeBlock { 700; }
extendEnd = Curve.ExtendEnd(curve=list_create, distance=code_block_8)
extendStart = Curve.ExtendStart(curve=extendEnd, distance=code_block_8)
byLine = Grid.ByLine(line=extendStart)
mul = _ * _  # unwired: x, y
code_block_9 = CodeBlock {  }
