# Dynamo graph 파싱예제.dyn (Dynamo 2.16.1.2727)

# group: 숫자6개 -> 점1개
file_path = Filename(".\숫자6개.xlsx")
file_from_path = FileObject(path=file_path)
code_block = CodeBlock { "Sheet1"; }
importExcel = Data.ImportExcel(file=file_from_path, sheetName=code_block)

firstItem = List.FirstItem(list=importExcel)
code_block_2 = CodeBlock(excelSrc=firstItem) { excelSrc; }
code_block_3 = CodeBlock { null; }
indexOf = List.IndexOf(list=firstItem, element=code_block_3)
code_block_4 = CodeBlock(i=indexOf) { i-1; i+1; }
range = Range(end=code_block_4.out0)
getItemAtIndex = List.GetItemAtIndex(list=code_block_2, index=range)
code_block_5 = CodeBlock(i=getItemAtIndex) { i[0]; i[1]; i[2]; }
byCoordinates = Point.ByCoordinates(x=code_block_5.out0, y=code_block_5.out1, z=code_block_5.out2)
count = List.Count(list=firstItem)
code_block_6 = CodeBlock(i=count) { i-1; }
range_2 = Range(start=code_block_4.out1, end=code_block_6)
getItemAtIndex_2 = List.GetItemAtIndex(list=code_block_2, index=range_2)
code_block_7 = CodeBlock(i=getItemAtIndex_2) { i[0]; i[1]; i[2]; }
byCoordinates_2 = Point.ByCoordinates(x=code_block_7.out0, y=code_block_7.out1, z=code_block_7.out2)
byStartPointEndPoint = Line.ByStartPointEndPoint(startPoint=byCoordinates, endPoint=byCoordinates_2)

# group: 숫자12개 -> 선2개
file_path_2 = Filename(".\숫자12개.xlsx")
file_from_path_2 = FileObject(path=file_path_2)
code_block_8 = CodeBlock { "Sheet1"; }
importExcel_2 = Data.ImportExcel(file=file_from_path_2, sheetName=code_block_8)

code_block_9 = CodeBlock(total=importExcel_2) { total; }
code_block_10 = CodeBlock(excelSrc=code_block_9) { excelSrc; }
code_block_11 = CodeBlock { null; }
indexOf_2 = List.IndexOf(list=code_block_9@L2, element=code_block_11)
code_block_12 = CodeBlock(i=indexOf_2) { i-1; i+1; }
range_3 = Range(end=code_block_12.out0)
getItemAtIndex_3 = List.GetItemAtIndex(list=code_block_10@L2, index=range_3@L2)
code_block_13 = CodeBlock(i=getItemAtIndex_3) { i; 0; 1; 2; }
getItemAtIndex_4 = List.GetItemAtIndex(list=code_block_13.i@L2, index=code_block_13.out1)
getItemAtIndex_5 = List.GetItemAtIndex(list=code_block_13.i@L2, index=code_block_13.out2)
getItemAtIndex_6 = List.GetItemAtIndex(list=code_block_13.i@L2, index=code_block_13.out3)
byCoordinates_3 = Point.ByCoordinates(x=getItemAtIndex_4, y=getItemAtIndex_5, z=getItemAtIndex_6)
count_2 = List.Count(list=code_block_9@L2)
code_block_14 = CodeBlock(i=count_2) { i-1; }
range_4 = Range(start=code_block_12.out1, end=code_block_14)
getItemAtIndex_7 = List.GetItemAtIndex(list=code_block_10@L2, index=range_4@L2)
code_block_15 = CodeBlock(i=getItemAtIndex_7) { i; 0; 1; 2; }
getItemAtIndex_8 = List.GetItemAtIndex(list=code_block_15.i@L2, index=code_block_15.out1)
getItemAtIndex_9 = List.GetItemAtIndex(list=code_block_15.i@L2, index=code_block_15.out2)
getItemAtIndex_10 = List.GetItemAtIndex(list=code_block_15.i@L2, index=code_block_15.out3)
byCoordinates_4 = Point.ByCoordinates(x=getItemAtIndex_8, y=getItemAtIndex_9, z=getItemAtIndex_10)
byStartPointEndPoint_2 = Line.ByStartPointEndPoint(startPoint=byCoordinates_3, endPoint=byCoordinates_4)

# group: 숫자24개->선4개
file_path_3 = Filename(".\숫자24개.xlsx")
file_from_path_3 = FileObject(path=file_path_3)
code_block_16 = CodeBlock { "Sheet1"; }
importExcel_3 = Data.ImportExcel(file=file_from_path_3, sheetName=code_block_16)

code_block_17 = CodeBlock(total=importExcel_3) { total; }
code_block_18 = CodeBlock(excelSrc=code_block_17) { excelSrc; }
code_block_19 = CodeBlock { null; }
indexOf_3 = List.IndexOf(list=code_block_17@L2, element=code_block_19)
code_block_20 = CodeBlock(i=indexOf_3) { i-1; i+1; }
range_5 = Range(end=code_block_20.out0)
getItemAtIndex_11 = List.GetItemAtIndex(list=code_block_18@L2, index=range_5@L2)
code_block_21 = CodeBlock(i=getItemAtIndex_11) { i; 0; 1; 2; }
getItemAtIndex_12 = List.GetItemAtIndex(list=code_block_21.i@L2, index=code_block_21.out1)
getItemAtIndex_13 = List.GetItemAtIndex(list=code_block_21.i@L2, index=code_block_21.out2)
getItemAtIndex_14 = List.GetItemAtIndex(list=code_block_21.i@L2, index=code_block_21.out3)
byCoordinates_5 = Point.ByCoordinates(x=getItemAtIndex_12, y=getItemAtIndex_13, z=getItemAtIndex_14)
count_3 = List.Count(list=code_block_17@L2)
code_block_22 = CodeBlock(i=count_3) { i-1; }
range_6 = Range(start=code_block_20.out1, end=code_block_22)
getItemAtIndex_15 = List.GetItemAtIndex(list=code_block_18@L2, index=range_6@L2)
code_block_23 = CodeBlock(i=getItemAtIndex_15) { i; 0; 1; 2; }
getItemAtIndex_16 = List.GetItemAtIndex(list=code_block_23.i@L2, index=code_block_23.out1)
getItemAtIndex_17 = List.GetItemAtIndex(list=code_block_23.i@L2, index=code_block_23.out2)
getItemAtIndex_18 = List.GetItemAtIndex(list=code_block_23.i@L2, index=code_block_23.out3)
byCoordinates_6 = Point.ByCoordinates(x=getItemAtIndex_16, y=getItemAtIndex_17, z=getItemAtIndex_18)
byStartPointEndPoint_3 = Line.ByStartPointEndPoint(startPoint=byCoordinates_5, endPoint=byCoordinates_6)
byJoinedCurves = PolyCurve.ByJoinedCurves(curves=byStartPointEndPoint_3)
patch = Curve.Patch(curve=byJoinedCurves)
code_block_24 = CodeBlock(srf=patch) { srf; }
number_slider = DoubleSlider(5.2, range=0..10 step 0.1)
code_block_25 = CodeBlock(i=number_slider) { 4*i; }
thicken = Surface.Thicken(surface=code_block_24, thickness=code_block_25)
code_block_26 = CodeBlock(sc=number_slider) { sc/2; }
scale = Geometry.Scale(geometry=thicken, xamount=code_block_26, yamount=code_block_26, zamount=code_block_26)
categories = Categories("OST_GenericModel")  # frozen
byGeometry = DirectShape.ByGeometry(geometry=scale, category=categories)
