# Dynamo graph 패밀리리스트 파싱예제.dyn (Dynamo 2.16.1.2727)

file_path = Filename(".\팀 표준 패밀리 리스트 예제.xlsx")
file_from_path = FileObject(path=file_path)
code_block = CodeBlock { "5.St_Col"; }
importExcel = Data.ImportExcel(file=file_from_path, sheetName=code_block)
code_block_2 = CodeBlock(src=importExcel) { src; }
string_from_object = FromObject(object=code_block_2)
code_block_3 = CodeBlock { "NO"; }
contains = List.Contains(list=string_from_object@L2, item=code_block_3)
code_block_4 = CodeBlock { true; }
# note: 동일한 값이지만
# note: ↑ 하드코딩(수동입력값)
# ↓ 자동추출
# note: 사용자가 엑셀 상에서 데이터 행을 추가했을때,
# 변동된 데이터에 대응할 수 있는 방식은
# 아래쪽이다.
indexOf = List.IndexOf(list=contains, element=code_block_4)
code_block_5 = CodeBlock()
# ---------- code_block_5.designscript (12 lines) ----------
[Imperative]
{
	i = 0;
	b = [];
	a = [ 5, 10, 15 ];
	for(aa in a)
	{
		b[i] = aa * 2;
		i = i + 1;
	}
	return b;
};
# ----------------------------------------
code_block_6 = CodeBlock(src=importExcel) { src; }
code_block_7 = CodeBlock { 19..30; }
getItemAtIndex = List.GetItemAtIndex(list=code_block_6, index=code_block_7)
code_block_8 = CodeBlock(src=importExcel) { src; }
code_block_9 = CodeBlock { 7..17; }
getItemAtIndex_2 = List.GetItemAtIndex(list=code_block_8, index=code_block_9)
code_block_10 = CodeBlock { 5; }
getItemAtIndex_3 = List.GetItemAtIndex(list=getItemAtIndex_2@L2, index=code_block_10)
string_from_object_2 = FromObject(object=getItemAtIndex_3)
code_block_11 = CodeBlock { "H_"; }
contains_2 = String.Contains(string=string_from_object_2, searchFor=code_block_11)
filterByBoolMask = List.FilterByBoolMask(list=getItemAtIndex_3, mask=contains_2)

# group: 이걸 자동화 해보자
code_block_12 = CodeBlock { 1; }

getItemAtIndex_4 = List.GetItemAtIndex(list=code_block_2, index=code_block_12)
isNull = Object.IsNull(object=getItemAtIndex_4)
code_block_13 = CodeBlock { false; }
allIndicesOf = List.AllIndicesOf(list=isNull, item=code_block_13)
getItemAtIndex_5 = List.GetItemAtIndex(list=getItemAtIndex_4, index=allIndicesOf)
getItemAtIndex_6 = List.GetItemAtIndex(list=code_block_2@L2, index=allIndicesOf)
count = List.Count(list=getItemAtIndex_6)
cycle = List.Cycle(list=getItemAtIndex_5@L3, amount=count)
string_from_object_3 = FromObject(object=getItemAtIndex_6)
byKeysValues = DesignScript.Builtin.Dictionary.ByKeysValues(keys=cycle@L2, values=string_from_object_3@L2)
code_block_14 = CodeBlock { "Standard Type"; }
valueAtKey = DesignScript.Builtin.Dictionary.ValueAtKey(dictionary=byKeysValues, key=code_block_14)
code_block_15 = CodeBlock { "H_"; }
contains_3 = String.Contains(string=valueAtKey, searchFor=code_block_15)
code_block_16 = CodeBlock { true; }
allIndicesOf_2 = List.AllIndicesOf(list=contains_3, item=code_block_16)
code_block_17 = CodeBlock(cnt=count) { cnt; }
join = List.Join(list0=allIndicesOf_2, list1=code_block_17)
code_block_18 = CodeBlock { 0..1; 1; }
sublists = List.Sublists(list=join, ranges=code_block_18.out0, offset=code_block_18.out1)
count_2 = List.Count(list=sublists@L2)
code_block_19 = CodeBlock(i=count_2) { i!=1; }
filterByBoolMask_2 = List.FilterByBoolMask(list=sublists, mask=code_block_19)
firstItem = List.FirstItem(list=filterByBoolMask_2.in)
lastItem = List.LastItem(list=filterByBoolMask_2.in)
code_block_20 = CodeBlock(i=lastItem) { i-1; }
range = Range(start=firstItem, end=code_block_20)
getItemAtIndex_7 = List.GetItemAtIndex(list=byKeysValues, index=range)
code_block_21 = CodeBlock { "Family Type Name"; }
valueAtKey_2 = DesignScript.Builtin.Dictionary.ValueAtKey(dictionary=getItemAtIndex_7, key=code_block_21)
code_block_22 = CodeBlock { "H_"; }
contains_4 = String.Contains(string=valueAtKey_2, searchFor=code_block_22)
filterByBoolMask_3 = List.FilterByBoolMask(list=valueAtKey_2, mask=contains_4)
실_적용_패일리타입_명 = CodeBlock(i=filterByBoolMask_3.in) { i; }
code_block_23 = CodeBlock(i=filterByBoolMask_3.out) { i!="null"; }
filterByBoolMask_4 = List.FilterByBoolMask(list=filterByBoolMask_3.out, mask=code_block_23)
표준타입_공통_workmaster_정보 = CodeBlock(i=filterByBoolMask_4.in) { i; }
code_block_24 = CodeBlock()
# ---------- code_block_24.designscript (2 lines) ----------
"실행_
물량산출식";
# ----------------------------------------
valueAtKey_3 = DesignScript.Builtin.Dictionary.ValueAtKey(dictionary=getItemAtIndex_7, key=code_block_24)
indexOf_2 = List.IndexOf(list=valueAtKey_2@L2, element=filterByBoolMask_4.in@L2)
getItemAtIndex_8 = List.GetItemAtIndex(list=valueAtKey_3@L2, index=indexOf_2@L2)
