# Dynamo graph [H_PAB.RT.Q2]_Revit 물량 산출_[3.0.6]_부가기능1.dyn (Dynamo 2.16.1.2727)
# author: MK Jang
# Auto Calculating the Quantities of each Element As per the Family List

n2_물량산출모드_입찰_실행 = CustomSelection("입찰", items={입찰: "입찰", 실행: "실행"})  # "2. 물량산출모드(입찰 / 실행)"; graph input

# group: All Elements in Revit
categories = Categories("OST_Rooms")
all_elements_of_category = ElementsOfCategory(Category=categories)
list_create = List.Create(item0=all_elements_of_category)
categories_2 = Categories("OST_Gutter")
all_elements_of_category_2 = ElementsOfCategory(Category=categories_2)
list_create_2 = List.Create(item0=all_elements_of_category_2)
all_elementsexceptrails = Python()  # CPython3; unwired: IN[0]
# ---------- all_elementsexceptrails.python (51 lines) ----------
# Load the Python Standard and DesignScript Libraries
import sys
import clr
clr.AddReference('ProtoGeometry')
from Autodesk.DesignScript.Geometry import *

clr.AddReference('RevitAPI')
from Autodesk.Revit.DB import *
import Autodesk

clr.AddReference('RevitServices')
import RevitServices
from RevitServices.Persistence import DocumentManager
doc = DocumentManager.Instance.CurrentDBDocument

def get_all_BIC():

    db = [
    Autodesk.Revit.DB.BuiltInCategory.OST_Floors,
    Autodesk.Revit.DB.BuiltInCategory.OST_Roofs,
    Autodesk.Revit.DB.BuiltInCategory.OST_Walls,
    Autodesk.Revit.DB.BuiltInCategory.OST_StructuralFoundation,
    Autodesk.Revit.DB.BuiltInCategory.OST_StructuralColumns,
    Autodesk.Revit.DB.BuiltInCategory.OST_StructuralFraming,
    Autodesk.Revit.DB.BuiltInCategory.OST_Ceilings,
    Autodesk.Revit.DB.BuiltInCategory.OST_Doors,
    Autodesk.Revit.DB.BuiltInCategory.OST_Windows,
    Autodesk.Revit.DB.BuiltInCategory.OST_Stairs,
    #Autodesk.Revit.DB.BuiltInCategory.OST_Railings,
    ]
    return db
    
def get_allElems(doc):
    bics = get_all_BIC()
    
    def getElems(x):
        collector = FilteredElementCollector(doc)
        res = collector.OfCategory(x).WhereElementIsNotElementType().ToElements()
        return res

    def getRailElems(x):
        collector = FilteredElementCollector(doc)
        res = collector.OfCategory(x).WhereElementIsNotElementType()
        return res

    res = map(getElems, bics)
#    res = getRailElems(Autodesk.Revit.DB.BuiltInCategory.OST_RailingSystemRail)
    return res


OUT = get_allElems(doc)
# ----------------------------------------
categories_3 = Categories("OST_EdgeSlab")
all_elements_of_category_3 = ElementsOfCategory(Category=categories_3)
list_create_3 = List.Create(item0=all_elements_of_category_3)
categories_4 = Categories("OST_StairsRailing")
all_elements_of_category_4 = ElementsOfCategory(Category=categories_4)
list_create_4 = List.Create(item0=all_elements_of_category_4)
categories_5 = Categories("OST_GenericModel")
all_elements_of_category_5 = ElementsOfCategory(Category=categories_5)
type = Object.Type(object=all_elements_of_category_5)
code_block = CodeBlock(i=type) { i!="Revit.Elements.DirectShape"; }
filterByBoolMask = List.FilterByBoolMask(list=all_elements_of_category_5, mask=code_block)
list_create_5 = List.Create(item0=filterByBoolMask.in)
join = List.Join(list0=list_create, list1=list_create_2, list2=all_elementsexceptrails, list3=list_create_3, list4=list_create_4, list5=list_create_5)

code_block_2 = CodeBlock { "IfcGUID"; }
getParameterValueByName = Element.GetParameterValueByName(element=join, parameterName=code_block_2)
parameters = Element.Parameters(element=join)

# group: All Data In Excel
target_sheet_names = CodeBlock()
# ---------- target_sheet_names.designscript (18 lines) ----------
[
"WM-AR"
,"산출기준"
,"0.Room"
,"1.Floors"
,"2.Roofs"
,"3.Walls_Ext"
,"3.Walls_Int"
,"4.St_Fdn"
,"5.St_Col"
,"6.St_Framing"
,"7.Ceilings"
,"8.Doors"
,"9.Windows"
,"10.Stairs"
,"11.Railings"
,"12.Generic"
];
# ----------------------------------------
n1_family_list_경로_입력 = Filename("..\etc\_팀교육\BIM_다이나모 전문가 육성\2차 육성\1주차\(H_PAB.OD.L2)_BIM 팀 표준 패밀리 리스트_r4(24.06.01)_HGEN PCB_240617_error.xlsx")  # "1. Family List 경로 입력"; graph input
file_from_path = FileObject(path=n1_family_list_경로_입력)
boolean = BoolSelector(true)
importExcel = Data.ImportExcel(file=file_from_path, sheetName=target_sheet_names, showExcel=boolean)

code_block_3 = CodeBlock(sheetNames=target_sheet_names) { sheetNames; }
code_block_4 = CodeBlock { 2; }
dropItems = List.DropItems(list=code_block_3, amount=code_block_4)
code_block_5 = CodeBlock { 2; }
dropItems_2 = List.DropItems(list=importExcel, amount=code_block_5)
code_block_6 = CodeBlock { "Standard Type"; }
indexOf = List.IndexOf(list=dropItems_2@L2, element=code_block_6)
code_block_7 = CodeBlock(i=indexOf) { i>0; }

# group: 카테코리 시트 별 Standard Type 칼럼의 열번호
filterByBoolMask_2 = List.FilterByBoolMask(list=indexOf, mask=code_block_7)

# group: 각 카테고리 시트 마다 F 열 데이터 추출
getItemAtIndex = List.GetItemAtIndex(list=dropItems_2@@L4, index=filterByBoolMask_2.in@L2)

code_block_8 = CodeBlock { ""; }
isNull = Object.IsNull()  # unwired: object
replaceByCondition = Replace(item=getItemAtIndex, replaceWith=code_block_8, condition=isNull)
string_from_object = FromObject(object=replaceByCondition)
code_block_9 = CodeBlock { "H_"; }
startsWith = String.StartsWith(string=string_from_object, searchFor=code_block_9)
filterByBoolMask_3 = List.FilterByBoolMask(list=string_from_object, mask=startsWith)
count = List.Count(list=filterByBoolMask_3.in@L2)
uniqueItems = List.UniqueItems(list=filterByBoolMask_3.in@L2)
count_2 = List.Count(list=uniqueItems@L2)
ne = count != count_2
boolean_2 = BoolSelector(true)
allIndicesOf = List.AllIndicesOf(list=ne, item=boolean_2)
getItemAtIndex_2 = List.GetItemAtIndex(list=dropItems, index=allIndicesOf)
code_block_10 = CodeBlock { true; }
