# Dynamo graph 산출실습샘플_7주차.dyn (Dynamo 2.16.1.2727)

# group: All Fdn Elements and It's Type Name
categories = Categories("OST_StructuralFoundation")
all_elements_of_category = ElementsOfCategory(Category=categories)
code_block = CodeBlock { "Family and Type"; }
getParameterValueByName = Element.GetParameterValueByName(element=all_elements_of_category, parameterName=code_block)
code_block_2 = CodeBlock { "Type Name"; }
getParameterValueByName_2 = Element.GetParameterValueByName(element=getParameterValueByName, parameterName=code_block_2)

uniqueItems = List.UniqueItems(list=getParameterValueByName_2)
code_block_3 = CodeBlock { "workmaster_codes"; }

# group: WM assign to Family Type
code_block_4 = CodeBlock()
# ---------- code_block_4.designscript (14 lines) ----------
[
"A03AD032-00022 Concrete Work Substructure Work Structural Concrete  Cement Type-1 25MPa ≤ F'c (Cylinder Strength) < 30MPa     ",
"A03AD037-00002 Concrete Work Substructure Work Rebar Work Deformed Bar (Non-Coat.)  400MPa<Fy≤470MPa     ",
"A03AD035-00001 Concrete Work Substructure Work Form Work (3 times in use) Flat Form     Dressed Lumber, Plywood or Steel Form(Wood Planks are not Allowed) incl. Chamfer  ",
"A03AH056-00001 Concrete Work Concrete Protective Coating (U/G) Bitumen/Bituminous/Asphalt Coating        ",
"A01ZZ001-00012 Earth Work - Excavation Soil, Mech.      Manual Excavation Above GWL ",
"A01ZZ001-00013 Earth Work - Excavation Soil, Mech.      Manual Excavation Below GWL ",
"A01ZZ003-00001 Earth Work - Backfill Re-use, Soil       ",
"A01ZZ004-00001 Earth Work - Disposal Soil       ",
"A03AD034-00013 Concrete Work Substructure Work Lean Concrete (including Form work)  Cement Type-1 10MPa ≤ F'c (Cylinder Strength) < 15MPa     ",
"A01ZZ012-00002 Earth Work - PE Sheet (Vapor Barrier)        THK ≤ 0.25mm (or 0.01 inch)",
"A01ZZ005-00001 Earth Work - Base Course        THK≤150mm",
"A01ZZ006-00001 Earth Work - Subbase Course      Including Compaction of Sub-Grade  THK≤150mm"
];
# ----------------------------------------
code_block_5 = CodeBlock()
# ---------- code_block_5.designscript (14 lines) ----------
[
"=V",
"=V*RE",
"=2*(W/1000 + D/1000) * (T/1000)",
"=2*(W/1000 + D/1000) * (T/1000)+2*(W/1000*D/1000)",
"=Exca",
"=Exca",
"=Back",
"=Disp",
"=(W/1000+2*D1)*(D/1000+2*D1) * C1",
"=(W/1000+2*D1)*(D/1000+2*D1)",
"=(W/1000+2*D1)*(D/1000+2*D1)",
"=(W/1000+2*D1)*(D/1000+2*D1)"
];
# ----------------------------------------

byKeysValues = DesignScript.Builtin.Dictionary.ByKeysValues(keys=code_block_3, values=code_block_4@L3)

# group: 산출규칙: 모델 파라미터
code_block_6 = CodeBlock()
# ---------- code_block_6.designscript (7 lines) ----------
[
"V",
"A",
"P",
"T",
"H2"
];
# ----------------------------------------
code_block_7 = CodeBlock()
# ---------- code_block_7.designscript (7 lines) ----------
[
"Volume",
"Area",
"Perimeter",
"Thickness",
"Elevation at Bottom"
];
# ----------------------------------------

code_block_8 = CodeBlock { "입찰"; }

# group: Final Calculation
code_block_9 = CodeBlock(calcMode=code_block_8) { calcMode; }
calcTypeDict_symValPair = CodeBlock { i[2]; }  # frozen; unwired: i
code_block_10 = CodeBlock(i=calcTypeDict_symValPair) { i["SF-Q0"]; }
토공_계산_1_1_2 = Python(IN[3]=code_block_10)  # CPython3; unwired: IN[0], IN[1], IN[2], IN[4]
# ---------- 토공_계산_1_1_2.python (584 lines) ----------
# Load the Python Standard and DesignScript Libraries
import sys
import clr
clr.AddReference('ProtoGeometry')
from Autodesk.DesignScript.Geometry import *

import Revit

################Module For Functional Programing##########################
from functools import reduce
from itertools import chain
from itertools import groupby
from copy import deepcopy
curry = lambda f: lambda a,*args: f(a, *args) if (len(args)) else lambda *args: f(a, *args)

filter = curry(filter)
map = curry(map)
reduce = curry(reduce)

go = lambda *args: reduce(lambda a,f: f(a), args) ## 함수도 축약 가능 ##

def dictUpdate(dic1,dic2):
    res = dic1.update(dic2)
    #res = {**dic1,**dic2}
    return dic1 #res
    
def dictsMerge(dics):
    res = reduce(dictUpdate, dics)
    return res
    
def dictDeleteKeys(dic, keys):
    for k in keys:
        del dic[k]
    return dic
##########################################################################

# The inputs to this node will be stored as a list in the IN variables.
dataEnteringNode = IN
calcMode = IN[0]
excaMode = IN[1]
elemDicts = IN[2]
earth_CommonInfoDict = IN[3]
FL_Z = IN[4]
#test_sample = elemDicts[303]

# Place your code below this line
LD = earth_CommonInfoDict["LD"]
BasePoint_Calibration = Revit.Elements.Coordinates.BasePoint().Z
#GL = Revit.Elements.Coordinates.BasePoint().Z - LD * 1000
GL = FL_Z - BasePoint_Calibration - LD * 1000

GWL_ = earth_CommonInfoDict["GWL"] * 1000

GWL = earth_CommonInfoDict["GWL"] * 1000# - BasePoint_Calibration

GWLplane = Plane.ByOriginNormal(Point.ByCoordinates(0,0,GWL_ + BasePoint_Calibration), Vector.ByCoordinates(0,0,1))

def find_belowSrf_simple(elem):
    res = go(
        elem.Geometry(),
        map(BoundingBox.ByGeometry), map(BoundingBox.ToCuboid),
        map(lambda x: x.Explode()),
        lambda x: list(chain(*x)),
        filter(lambda x: x.NormalAtParameter(0.5,0.5).Z < -0.1),list,
    )
    if res:
        return res

def find_belowSrf_complex(elem):
    res = go(
        elem.Geometry(),
        #map(BoundingBox.ByGeometry), map(BoundingBox.ToCuboid),
        map(lambda x: x.Explode()),
        lambda x: list(chain(*x)),
        filter(lambda x: x.NormalAtParameter(0.5,0.5).Z < -0.1),list,
    )
    if res:
        return res
        
def find_aboveSrf_simple(elem):
    res = go(
        elem.Geometry(),
        map(BoundingBox.ByGeometry), map(BoundingBox.ToCuboid),
        map(lambda x: x.Explode()),
        lambda x: list(chain(*x)),
        filter(lambda x: x.NormalAtParameter(0.5,0.5).Z == 1),list,
    )
    if res:
        return res
        
def add_defaultEarthInfo(elemDict, GWL, GL, BasePoint_Calibration):
    elem = elemDict["Elem"]
    if "_ExcaTgt" in elemDict["wms"]["Family Type Name"]:
        btmSrfs = find_belowSrf_complex(elem)
        btmSrfs = btmSrfs if btmSrfs else []
    else:
        btmSrfs = find_belowSrf_simple(elem)
        btmSrfs = btmSrfs if btmSrfs else []
    uprSrfs = find_aboveSrf_simple(elem)
    uprSrfs = uprSrfs if uprSrfs else []
    
    try:    
        if "Lean" not in elemDict["wms"]["Family Type Name"]:
            leanThk = elemDict["wms"]["Post_Sym_Val Dict"]["C1"] * 1000
            baseThk = elemDict["wms"]["Post_Sym_Val Dict"]["C2"] * 1000
            subBaseThk = elemDict["wms"]["Post_Sym_Val Dict"]["C3"] * 1000
            extraThk = elemDict["wms"]["Post_Sym_Val Dict"]["C4"] * 1000
        else:
            leanThk  = 0
            baseThk = elemDict["wms"]["Post_Sym_Val Dict"]["C2"] * 1000
            subBaseThk = elemDict["wms"]["Post_Sym_Val Dict"]["C3"] * 1000
            extraThk = elemDict["wms"]["Post_Sym_Val Dict"]["C4"] * 1000
    except:
        leanThk  = 0
        baseThk = 0
        subBaseThk = 0
        extraThk = 0
        

    base_downHeight = leanThk + baseThk + subBaseThk + extraThk
    
    btmZ = min( list(map(lambda x: x.PointAtParameter(0.5,0.5).Z, btmSrfs))\
                        if btmSrfs else [0] ) - BasePoint_Calibration
    uprZ = max( list(map(lambda x: x.PointAtParameter(0.5,0.5).Z, uprSrfs))\
                        if uprSrfs else [0] ) - BasePoint_Calibration
    
    btmArea = sum(list(map(lambda x: x.Area, btmSrfs)))
    elem_Volume = btmArea * abs(uprZ - btmZ) / 1000000000
    Btm_toGWL_volume = btmArea * ( GWL - (btmZ - base_downHeight) ) / 1000000000
    GWL_toGL_volume = btmArea * ( GL - GWL ) / 1000000000
    Btm_toGL_volume = btmArea * ( GL - (btmZ - base_downHeight) ) / 1000000000
    
    res = {
        "isExca": False,
        "btmSrfs": btmSrfs,
        "uprSrfs": uprSrfs,
        "btmArea": btmArea,
        "btmZ": btmZ,
        "uprZ": uprZ,
        "elem_Volume": elem_Volume,
        "Btm_toGWL_volume": Btm_toGWL_volume\
                            if Btm_toGWL_volume > 0 else 0 ,
        "GWL_toGL_volume": GWL_toGL_volume\
                            if GWL_toGL_volume > 0 else 0 ,
        "Btm_toGL_volume": Btm_toGL_volume\
                            if Btm_toGL_volume > 0 else 0 ,
    }
    
    
    elemDict["earthInfo"] = res
    return elemDict

def filter_EarthworkCalcTarget(elemDicts, GWL, GL, BasePoint_Calibration):
    ruleCondition = lambda x:\
        "H1_" in x["wms"]["Family Type Name"] or\
        "S18_Shallow" in x["wms"]["Family Type Name"] or\
        "S18_W" in x["wms"]["Family Type Name"] or\
        "S18_MAT" in x["wms"]["Family Type Name"] or\
        "B01_MAT" in x["wms"]["Family Type Name"] or\
        "S18_Wall" in x["wms"]["Family Type Name"] or\
        "B01" in x["wms"]["Family Type Name"] or\
        "B08_UG RC Slab" in x["wms"]["Family Type Name"] or\
        "B08_Ext Wall_RC_UG_Pit" in x["wms"]["Family Type Name"] or\
        "S16_UG" in x["wms"]["Family Type Name"] or\
        "S16_TG" in x["wms"]["Family Type Name"] or\
        "S17_SOG" in x["wms"]["Family Type Name"] or\
        "S17_Gr" in x["wms"]["Family Type Name"] or\
        "S17_EQ-Pad" in x["wms"]["Family Type Name"] or\
        "S17_Edge" in x["wms"]["Family Type Name"] or\
        "S17_Suspend" in x["wms"]["Family Type Name"] or\
        "S15_UG" in x["wms"]["Family Type Name"] or\
        "B08_Stoop" in x["wms"]["Family Type Name"] or\
        "B08_Ramp" in x["wms"]["Family Type Name"] or\
        "_ExcaTgt" in x["wms"]["Family Type Name"]
    res = go(
        elemDicts,
        filter(lambda x: ruleCondition(x)),
        map( lambda x: add_defaultEarthInfo(x, GWL, GL, BasePoint_Calibration) ),
        list,
    )
    remain = go(
        elemDicts,
        filter(lambda x: not ruleCondition(x)),
        list,
    )
    return res, remain


def filter_ExcaTarget(earthworkCalcTargets):
    res = go(
        earthworkCalcTargets,
        filter(lambda x:
            "B08_Ext Wall" not in x["wms"]["Family Type Name"] and
            "B02_Ext Wall" not in x["wms"]["Family Type Name"] and
            "S15_UG" not in x["wms"]["Family Type Name"]
        ),
        list,
    )
    for x in res:
        x["earthInfo"]["isExca"] = True
    return res


def find_eachExcaShape(elemDict, GWL, GL, LD, BasePoint_Calibration):
    belowSrfs = elemDict["earthInfo"]["btmSrfs"]
    btm_GL_Z = elemDict["earthInfo"]["btmZ"]
    G = elemDict["wms"]["Post_Sym_Val Dict"]["G"]
    GL_FL_gap = LD
    
    if "Lean" not in elemDict["wms"]["Family Type Name"]:
        leanThk = elemDict["wms"]["Post_Sym_Val Dict"]["C1"] * 1000
    else:
        leanThk  = 0
        
    baseThk = elemDict["wms"]["Post_Sym_Val Dict"]["C2"] * 1000
    subBaseThk = elemDict["wms"]["Post_Sym_Val Dict"]["C3"] * 1000
    extraThk = elemDict["wms"]["Post_Sym_Val Dict"]["C4"] * 1000
    base_downHeight = leanThk + baseThk + subBaseThk + extraThk
    
    if btm_GL_Z < -0.1:
        excaHeight = (-btm_GL_Z + base_downHeight)
    else:
        excaHeight = base_downHeight
        
    leanOffset = elemDict["wms"]["Post_Sym_Val Dict"]["D1"] * 1000
    excaOffset = elemDict["wms"]["Post_Sym_Val Dict"]["D2"] * 1000
    belowOffset = leanOffset + excaOffset
    #upperOffset = G * excaHeight
    upperOffset = G * excaHeight + belowOffset
    
    find_belowRef = lambda belowSrf: go(
        belowSrf,
        lambda x: x.Translate(0, 0, -base_downHeight),
        lambda x: x.PerimeterCurves(),
        PolyCurve.ByJoinedCurves,
        lambda x: x.OffsetMany(-belowOffset, False, Vector.ZAxis()),
        lambda x: x[0],
        Surface.ByPatch,
        BoundingBox.ByGeometry,
        lambda x: [x.MinPoint, x.MaxPoint],
        lambda x: Cuboid.ByCorners(*x),
        lambda x: x.Explode()[0],
        lambda x: x.PerimeterCurves(),
        PolyCurve.ByJoinedCurves,
    )
    
    find_upperRef = lambda belowSrf: go(
        belowSrf,
        lambda x: x.Translate(0, 0, -btm_GL_Z - LD*1000),
        lambda x: x.PerimeterCurves(),
        PolyCurve.ByJoinedCurves,
        lambda x: x.OffsetMany(-upperOffset, False, Vector.ZAxis()),
        lambda x: x[0],
        Surface.ByPatch,
        BoundingBox.ByGeometry,
        lambda x: [x.MinPoint, x.MaxPoint],
        lambda x: Cuboid.ByCorners(*x),
        lambda x: x.Explode()[0],
        lambda x: x.PerimeterCurves(),
        PolyCurve.ByJoinedCurves,
    )
    
    belowRefs = list(map(find_belowRef, belowSrfs))
    upperRefs = list(map(find_upperRef, belowSrfs))
    exca_RefGroups = list(zip(belowRefs,upperRefs))
    exca_Shape = Solid.ByUnion( map(Solid.ByLoft, exca_RefGroups) )
    
    return exca_Shape

def find_unionExcaShape(excaTargets, GWL, GL, LD, BasePoint_Calibration):
    excaSolids = []
    for elemDict in excaTargets:
        excaSolids.append( find_eachExcaShape(elemDict, GWL, GL, LD, BasePoint_Calibration) )
        res = Solid.ByUnion(excaSolids)
    return res
    
def find_unionExcaShape_whole(
        excaTargets, 
        GWL, 
        GL, 
        LD, 
        earth_CommonInfoDict, 
        BasePoint_Calibration
    ):
    
    allElems = list(map(lambda x: x["Elem"], excaTargets))
    def makeBdCube(e):
        eGeo = e.Geometry()[0]
        eBdBoxCube = BoundingBox.ByGeometry(eGeo).ToCuboid()
        return eBdBoxCube
    
    def find_elemsGeo(allElems):
        #flatten_Elems = list(chain(*excaTargets))
        allGeo = []
        for e in allElems:
            try:
                allGeo.append(makeBdCube(e))
            except:
                pass
        return allGeo
        
    def findWholeBdBox(allElems):
        allGeo = find_elemsGeo(allElems)
        unionBdCube = BoundingBox.ByGeometry(allGeo).ToCuboid()
        return unionBdCube
    
    find_belowRef = lambda belowSrf: go(
        belowSrf,
        lambda x: x.Translate(0, 0, -base_downHeight),
        lambda x: x.PerimeterCurves(),
        PolyCurve.ByJoinedCurves,
        lambda x: x.OffsetMany(-belowOffset, False, Vector.ZAxis()),
        lambda x: x[0],
        Surface.ByPatch,
        BoundingBox.ByGeometry,
        lambda x: [x.MinPoint, x.MaxPoint],
        lambda x: Cuboid.ByCorners(*x),
        lambda x: x.Explode()[0],
        lambda x: x.PerimeterCurves(),
        PolyCurve.ByJoinedCurves,
    )
    
    find_upperRef = lambda belowSrf: go(
        belowSrf,
        lambda x: x.Translate(0, 0, -btm_GL_Z - LD*1000),
        lambda x: x.PerimeterCurves(),
        PolyCurve.ByJoinedCurves,
        lambda x: x.OffsetMany(-upperOffset, False, Vector.ZAxis()),
        lambda x: x[0],
        Surface.ByPatch,
        BoundingBox.ByGeometry,
        lambda x: [x.MinPoint, x.MaxPoint],
        lambda x: Cuboid.ByCorners(*x),
        lambda x: x.Explode()[0],
        lambda x: x.PerimeterCurves(),
        PolyCurve.ByJoinedCurves,
    )

    unionBdCube = findWholeBdBox(allElems)
    belowSrfs = go(
        [unionBdCube],
        map(BoundingBox.ByGeometry), map(BoundingBox.ToCuboid),
        map(lambda x: x.Explode()),
        lambda x: list(chain(*x)),
        filter(lambda x: x.NormalAtParameter(0.5,0.5).Z < -0.1),list,
    )
    
    btm_GL_Z = min( list(map(lambda x: x.PointAtParameter(0.5,0.5).Z, belowSrfs))\
                        if belowSrfs else [0] ) - BasePoint_Calibration

    G = earth_CommonInfoDict["G"]
    GL_FL_gap = LD
    leanThk = earth_CommonInfoDict["C1"] * 1000
    baseThk = earth_CommonInfoDict["C2"] * 1000
    subBaseThk = earth_CommonInfoDict["C3"] * 1000
    extraThk = earth_CommonInfoDict["C4"] * 1000
    base_downHeight = leanThk + baseThk + subBaseThk + extraThk
    excaHeight = -btm_GL_Z + base_downHeight
    leanOffset = earth_CommonInfoDict["D1"] * 1000
    excaOffset = earth_CommonInfoDict["D2"] * 1000
    belowOffset = leanOffset + excaOffset
    #upperOffset = G * excaHeight
    upperOffset = G * excaHeight + belowOffset

    belowRefs = list(map(find_belowRef, belowSrfs))
    upperRefs = list(map(find_upperRef, belowSrfs))
    exca_RefGroups = list(zip(belowRefs,upperRefs))
    exca_Shape = Solid.ByUnion( map(Solid.ByLoft, exca_RefGroups) )
    
    return exca_Shape
    
def find_disposalShape(elemDict):
    elemDisposal_shape = Solid.ByUnion(list(elemDict["Elem"].Geometry()))
    
    leanThk = elemDict["wms"]["Post_Sym_Val Dict"]["C1"] * 1000
    baseThk = elemDict["wms"]["Post_Sym_Val Dict"]["C2"] * 1000
    subBaseThk = elemDict["wms"]["Post_Sym_Val Dict"]["C3"] * 1000
    extraThk = elemDict["wms"]["Post_Sym_Val Dict"]["C4"] * 1000
    base_downHeight = leanThk + baseThk + subBaseThk + extraThk
    
    belowSrfs = elemDict["earthInfo"]["btmSrfs"]
    offset = elemDict["wms"]["Post_Sym_Val Dict"]["D1"]*1000\
                + (elemDict["wms"]["Post_Sym_Val Dict"]["D2"]/2) *1000
    
    find_nonElemDisposal_belowRefs = lambda belowSrf: go(
        belowSrf,
        lambda x: x.Translate(0, 0, -base_downHeight),
        lambda x: x.PerimeterCurves(),
        PolyCurve.ByJoinedCurves,
        lambda x: x.OffsetMany(-offset, False, Vector.ZAxis()),
        lambda x: x[0],
        Surface.ByPatch,
        BoundingBox.ByGeometry,
        lambda x: [x.MinPoint, x.MaxPoint],
        lambda x: Cuboid.ByCorners(*x),
        lambda x: x.Explode()[0],
        lambda x: x.PerimeterCurves(),
        PolyCurve.ByJoinedCurves,
    )
    find_nonElemDisposal_upperRefs = lambda belowSrf: go(
        belowSrf,
        lambda x: x.PerimeterCurves(),
        PolyCurve.ByJoinedCurves,
        lambda x: x.OffsetMany(-offset, False, Vector.ZAxis()),
        lambda x: x[0],
        Surface.ByPatch,
        BoundingBox.ByGeometry,
        lambda x: [x.MinPoint, x.MaxPoint],
        lambda x: Cuboid.ByCorners(*x),
        lambda x: x.Explode()[0],
        lambda x: x.PerimeterCurves(),
        PolyCurve.ByJoinedCurves,
    )

    nonElemDisposal_belowRefs = list(map(find_nonElemDisposal_belowRefs, belowSrfs))
    nonElemDisposal_upperRefs = list(map(find_nonElemDisposal_upperRefs, belowSrfs))
    nonElemDisposal_RefGroups = list(zip(nonElemDisposal_belowRefs,nonElemDisposal_upperRefs))
    nonElemDisposal_Shape = Solid.ByUnion( map(Solid.ByLoft, nonElemDisposal_RefGroups) )
    disposal_shape = Solid.ByUnion( [elemDisposal_shape, nonElemDisposal_Shape] )
    
    return disposal_shape

def find_unionDisposalShape(earthCalcTargets):
    disposal_Solids = []
    for elemDict in earthCalcTargets:
        try:
            disposal_Solids.append( find_disposalShape(elemDict) )
        except:
            pass
    return Solid.ByUnion(disposal_Solids)
    
def add_dispoAndbackfill_qty_toElemDicts(earthCalcTargets, unionDisposalShape, unionBackfillShape):
    whole_disposalShape_volume = unionDisposalShape.Volume
    whole_backfillShape_volume = unionBackfillShape.Volume
    target = earthCalcTargets
    
    total_toGLvolume = go(
        target,
        map(lambda x: x["earthInfo"]["Btm_toGL_volume"]),
        sum,
    )
    
    def find_asignedQty_elemDict(d, wholeVolume):
        res = go(
            d,
            lambda x: (x["earthInfo"]["Btm_toGL_volume"] / total_toGLvolume) * wholeVolume,
            lambda x: x / 1000000000,
        )
        return res
     
    res = go(
        target,
        map( lambda x: 
            dict( x, **{"earthQty": {
                                        "disposal": find_asignedQty_elemDict(x, whole_disposalShape_volume),
                                        "backfill": find_asignedQty_elemDict(x, whole_backfillShape_volume),
                                    }} ) 
        ),
        list,
    )
    return res
    
def add_above_excavation_qty_toElemDicts(elemDicts, above_GWL_excaShape, below_GWL_excaShape):
    cond_inter_GWL = lambda x: x["earthInfo"]["Btm_toGWL_volume"] != 0 and \
                    x["earthInfo"]["Btm_toGWL_volume"] < x["earthInfo"]["elem_Volume"]
    cond_above_GWL = lambda x: x["earthInfo"]["Btm_toGWL_volume"] == 0
    cond_below_GWL = lambda x: x["earthInfo"]["Btm_toGWL_volume"] != 0 and \
                    x["earthInfo"]["Btm_toGWL_volume"] >= x["earthInfo"]["elem_Volume"]
    
    total_Btm_toGL_volume  = go(
        elemDicts,
        filter(lambda elemDict: elemDict["earthInfo"]["isExca"]),
        filter( lambda elemDict: cond_above_GWL(elemDict) ),
        map(lambda elemDict: elemDict["earthInfo"]["Btm_toGL_volume"]),
        sum,
    )
    total_GWL_toGL_volume  = go(
        elemDicts,
        filter(lambda elemDict: elemDict["earthInfo"]["isExca"]),
        filter( lambda elemDict: cond_inter_GWL(elemDict) or cond_below_GWL(elemDict) ),
        map(lambda elemDict: elemDict["earthInfo"]["GWL_toGL_volume"]),
        sum,
    )
    total_ref_volume = total_Btm_toGL_volume + total_GWL_toGL_volume
    exca_above_total_volume = above_GWL_excaShape.Volume
    exca_below_total_volume = below_GWL_excaShape.Volume
    
    def find_asignedQty_elemDict(elemDict):
        if elemDict["earthInfo"]["isExca"] and cond_inter_GWL(elemDict):
            elemDict["earthQty"]["exca_above"] = ( exca_above_total_volume * (elemDict["earthInfo"]["GWL_toGL_volume"] / total_ref_volume) ) / 1000000000
        elif elemDict["earthInfo"]["isExca"] and cond_above_GWL(elemDict):
            elemDict["earthQty"]["exca_above"] = ( exca_above_total_volume * (elemDict["earthInfo"]["Btm_toGL_volume"] / total_ref_volume) ) / 1000000000
        else:
            elemDict["earthQty"]["exca_above"] = 0.0
        return elemDict
    res = list(map( lambda x: find_asignedQty_elemDict(x), elemDicts ))
    return res

def add_below_excavation_qty_toElemDicts(elemDicts, above_GWL_excaShape, below_GWL_excaShape):
    cond_belowOrInter_GWL = lambda x: x["earthInfo"]["Btm_toGWL_volume"] != 0
    
    total_Btm_toGWL_volume  = go(
        elemDicts,
        filter(lambda elemDict: elemDict["earthInfo"]["isExca"]),
        filter( lambda elemDict: cond_belowOrInter_GWL(elemDict) ),
        map(lambda elemDict: elemDict["earthInfo"]["Btm_toGWL_volume"]),
        sum,
    )
    total_ref_volume = total_Btm_toGWL_volume
    exca_above_total_volume = above_GWL_excaShape.Volume
    exca_below_total_volume = below_GWL_excaShape.Volume
    
    def find_asignedQty_elemDict(elemDict):
        if elemDict["earthInfo"]["isExca"] and cond_belowOrInter_GWL(elemDict):
            elemDict["earthQty"]["exca_below"] = exca_below_total_volume/1000000000 * (elemDict["earthInfo"]["Btm_toGWL_volume"] / total_ref_volume)
        else:
            elemDict["earthQty"]["exca_below"] = 0.0
        return elemDict
    res = list(map( lambda x: find_asignedQty_elemDict(x), elemDicts ))
    return res


earthCalcTargets, remainElemDicts = filter_EarthworkCalcTarget(elemDicts, GWL, GL, BasePoint_Calibration)
excaTargets = filter_ExcaTarget(earthCalcTargets)

if excaMode == "개별터파기":
    unionExcaShape = find_unionExcaShape(excaTargets, GWL, GL, LD, BasePoint_Calibration)
    unionPreDisposalShape = find_unionDisposalShape(earthCalcTargets)
    unionBackfillShape = unionExcaShape.Split(unionPreDisposalShape)[0]
    unionBackfillShape_volume = unionBackfillShape.Volume
    unionDisposalShape = unionExcaShape.Split(unionPreDisposalShape)[1]
    
    if isinstance(unionExcaShape, list) and len(unionExcaShape) ==2:
        above_GWL_excaShape, below_GWL_excaShape = unionExcaShape.Split(GWLplane)
        earthCalcTargets_dispoAndbackfill = add_dispoAndbackfill_qty_toElemDicts(earthCalcTargets, unionDisposalShape, unionBackfillShape)
        earthCalcTargets_aboveExca = add_above_excavation_qty_toElemDicts(earthCalcTargets_dispoAndbackfill, above_GWL_excaShape, below_GWL_excaShape)
        earthCalcTargets_calcFinshed = add_below_excavation_qty_toElemDicts(earthCalcTargets_aboveExca, above_GWL_excaShape, below_GWL_excaShape)
        
        OUT = [earthCalcTargets_calcFinshed + remainElemDicts, unionBackfillShape]
    else:
        above_GWL_excaShape = unionExcaShape
        earthCalcTargets_dispoAndbackfill = add_dispoAndbackfill_qty_toElemDicts(earthCalcTargets, unionDisposalShape, unionBackfillShape)
        earthCalcTargets_aboveExca = add_above_excavation_qty_toElemDicts(earthCalcTargets_dispoAndbackfill, above_GWL_excaShape, above_GWL_excaShape)
        OUT = [earthCalcTargets_aboveExca + remainElemDicts, unionBackfillShape]
    
elif excaMode == "온통터파기":
    unionExcaShape = find_unionExcaShape_whole(excaTargets, GWL, GL, LD, earth_CommonInfoDict)
    unionPreDisposalShape = find_unionDisposalShape(earthCalcTargets)
    unionBackfillShape = unionExcaShape.Split(unionPreDisposalShape)[0]
    unionBackfillShape_volume = unionBackfillShape.Volume
    unionDisposalShape = unionExcaShape.Split(unionPreDisposalShape)[1]
    unionDisposalShape_volume = unionDisposalShape.Volume
    
    if isinstance(unionExcaShape, list) and len(unionExcaShape) ==2:
        above_GWL_excaShape, below_GWL_excaShape = unionExcaShape.Split(GWLplane)
        earthCalcTargets_dispoAndbackfill = add_dispoAndbackfill_qty_toElemDicts(earthCalcTargets, unionDisposalShape, unionBackfillShape)
        earthCalcTargets_aboveExca = add_above_excavation_qty_toElemDicts(earthCalcTargets_dispoAndbackfill, above_GWL_excaShape, below_GWL_excaShape)
        earthCalcTargets_calcFinshed = add_below_excavation_qty_toElemDicts(earthCalcTargets_aboveExca, above_GWL_excaShape, below_GWL_excaShape)
        
        OUT = [earthCalcTargets_calcFinshed + remainElemDicts, unionBackfillShape]
    else:
        above_GWL_excaShape = unionExcaShape
        earthCalcTargets_dispoAndbackfill = add_dispoAndbackfill_qty_toElemDicts(earthCalcTargets, unionDisposalShape, unionBackfillShape)
        earthCalcTargets_aboveExca = add_above_excavation_qty_toElemDicts(earthCalcTargets_dispoAndbackfill, above_GWL_excaShape, above_GWL_excaShape)
        OUT = [earthCalcTargets_aboveExca + remainElemDicts, unionBackfillShape]


#    above_GWL_excaShape, below_GWL_excaShape = unionExcaShape.Split(GWLplane)
#    
#    earthCalcTargets_dispoAndbackfill = add_dispoAndbackfill_qty_toElemDicts(earthCalcTargets, unionDisposalShape, unionBackfillShape)
#    
#    earthCalcTargets_aboveExca = add_above_excavation_qty_toElemDicts(earthCalcTargets_dispoAndbackfill, above_GWL_excaShape, below_GWL_excaShape)
#    earthCalcTargets_calcFinshed = add_below_excavation_qty_toElemDicts(earthCalcTargets_aboveExca, above_GWL_excaShape, below_GWL_excaShape)
#    
#    OUT = earthCalcTargets_calcFinshed + remainElemDicts

# Assign your output to the OUT variable.
#OUT = earthCalcTargets
#OUT = unionExcaShape.Volume/1000000000
#OUT = above_GWL_excaShape.Volume/1000000000, below_GWL_excaShape.Volume/1000000000
#OUT = above_GWL_excaShape, below_GWL_excaShape
#OUT = unionDisposalShape_volume/1000000000, unionBackfillShape_volume/1000000000
#OUT = earthCalcTargets_calcFinshed, []
#OUT = earthCalcTargets_calcFinshed + remainElemDicts
# ----------------------------------------
code_block_11 = CodeBlock(i=토공_계산_1_1_2) { i[1]; i[0]; }
토공관련_wm들_물량산출_수식_처리구간 = Python(IN[0]=code_block_11.out1)  # CPython3
# ---------- 토공관련_wm들_물량산출_수식_처리구간.python (79 lines) ----------
# Load the Python Standard and DesignScript Libraries
import sys
import clr
clr.AddReference('ProtoGeometry')
from Autodesk.DesignScript.Geometry import *

################Module For Functional Programing##########################
from functools import reduce
from itertools import chain
from itertools import groupby
from copy import deepcopy
curry = lambda f: lambda a,*args: f(a, *args) if (len(args)) else lambda *args: f(a, *args)

filter = curry(filter)
map = curry(map)
reduce = curry(reduce)

go = lambda *args: reduce(lambda a,f: f(a), args) ## 함수도 축약 가능 ##

def dictUpdate(dic1,dic2):
    res = dic1.update(dic2)
    #res = {**dic1,**dic2}
    return dic1 #res
    
def dictsMerge(dics):
    res = reduce(dictUpdate, dics)
    return res
    
def dictDeleteKeys(dic, keys):
    for k in keys:
        del dic[k]
    return dic
##########################################################################

# The inputs to this node will be stored as a list in the IN variables.
dataEnteringNode = IN
elemDicts = IN[0]
#test_sample = elemDicts[303]

# Place your code below this line

def tmp_switchEarthworkFormula(elemDict):
    
    for i in elemDict["wms"]["wmSpecs"]:
        calcFormulas = filter(lambda x: "산출식" in x ,list(i.Keys))
        for k in calcFormulas:
            if i[k] in ["=Exca", "=Back", "=Disp"]:
                i[k] = "_tbd"
        
    return elemDict

def tmp_switchEarthworkFormula_allDicts(elemDicts):
    return list(map(tmp_switchEarthworkFormula, elemDicts))

def switchEarthworkFormula(elemDict):
    for i in elemDict["wms"]["wmSpecs"]:
        calcFormulas = filter(lambda x: "산출식" in x ,list(i.Keys))
        for k in calcFormulas:
            if i[k] == "=Exca" and "Above" in i["Spec. 7- L10"]:
                i[k] = f'= {elemDict["earthQty"]["exca_above"]}'
                
            elif i[k] == "=Exca" and "Below" in i["Spec. 7- L10"]:
                try:
                    i[k] = f'= {elemDict["earthQty"]["exca_below"]}'
                except:
                    i[k] = f'= 0'
                
            elif i[k] == "=Back":
                i[k] = f'= {elemDict["earthQty"]["backfill"]}'
                
            elif i[k] == "=Disp":
                i[k] = f'= {elemDict["earthQty"]["disposal"]}'
    
    return elemDict

def switchEarthworkFormula_allDicts(elemDicts):
    return list(map(switchEarthworkFormula, elemDicts))
# Assign your output to the OUT variable.
OUT = switchEarthworkFormula_allDicts(elemDicts)
# ----------------------------------------
부재_wm_별_산식에_의한_최종_계산 = Python(IN[0]=code_block_9, IN[1]=토공관련_wm들_물량산출_수식_처리구간)  # CPython3
# ---------- 부재_wm_별_산식에_의한_최종_계산.python (108 lines) ----------
# Load the Python Standard and DesignScript Libraries
import sys
import clr

clr.AddReference('RevitAPI')
from Autodesk.Revit.DB import *
import Autodesk

clr.AddReference('RevitNodes')
import Revit
clr.ImportExtensions(Revit.Elements)

clr.AddReference('RevitServices')
import RevitServices
from RevitServices.Persistence import DocumentManager
from RevitServices.Transactions import TransactionManager
doc = DocumentManager.Instance.CurrentDBDocument
uiapp = DocumentManager.Instance.CurrentUIApplication
app = uiapp.Application
#collector1 = FilteredElementCollector(doc)

clr.AddReference('ProtoGeometry')
from Autodesk.DesignScript.Geometry import *

################Module For Functional Programing##########################
from functools import reduce
from itertools import chain
from itertools import groupby
from copy import deepcopy
curry = lambda f: lambda a,*args: f(a, *args) if (len(args)) else lambda *args: f(a, *args)

filter = curry(filter)
map = curry(map)
reduce = curry(reduce)

go = lambda *args: reduce(lambda a,f: f(a), args) ## 함수도 축약 가능 ##

def dictUpdate(dic1,dic2):
    res = dic1.update(dic2)
    #res = {**dic1,**dic2}
    return dic1 #res
    
def dictsMerge(dics):
    res = reduce(dictUpdate, dics)
    return res
    
def dictDeleteKeys(dic, keys):
    for k in keys:
        del dic[k]
    return dic
##########################################################################
# The inputs to this node will be stored as a list in the IN variables.
dataEnteringNode = IN

calcMode = IN[0]
elemDicts = IN[1]


# Place your code below this line

def calcFormula_each_WmSpecs(elemDicts, calcMode):
    calc_key = "실행_물량산출식" if calcMode=="실행" else "입찰_물량산출식"
    
    def calcFormula_dict(d):
        e = d["Elem"]
        wmSpecss = d["wms"]["wmSpecs"]
        if "Post_Sym_Val Dict" in d["wms"].Keys:
            postSymValDict = d["wms"]["Post_Sym_Val Dict"]
            Sym_Vals = list(zip(postSymValDict.Keys, list(map(str, postSymValDict.Values))))
            sortedSym_Vals = sorted(Sym_Vals, key=lambda x: len(x[0]), reverse=True)
            for i in wmSpecss:
                applyFormula = str( i[calc_key] )
                if not applyFormula.startswith('_'):
                    substFormula = applyFormula
                    for x in sortedSym_Vals:
                        substFormula = substFormula.replace(*x)
                    i["applyFormula"] = "'"+ applyFormula
                    i["substFormula"] = "'"+ substFormula
                    try:
                        i["Quantity"] = round(eval(substFormula.strip('=')),3)
                    except:
                        i["Quantity"] = "'"+ substFormula
                else:
                    i["applyFormula"] = "'"+ applyFormula
                    i["substFormula"] = "'"+ applyFormula
                    i["Quantity"] = ""
        else:
            for i in wmSpecss:
                try:
                    applyFormula = str( i[calc_key] )
                    substFormula = applyFormula
                    i["applyFormula"] = "'"+ applyFormula
                    i["substFormula"] = "'"+ substFormula
                    i["Quantity"] = round(eval(substFormula.strip('=')),3)
                except:
                    i["Quantity"] = 0
        return d
    res = []
    for d in elemDicts:
        res.append(calcFormula_dict(d))
    
    return res




# Assign your output to the OUT variable.
OUT = calcFormula_each_WmSpecs(elemDicts, calcMode)
# ----------------------------------------

code_block_12 = CodeBlock(allFdnElems=all_elements_of_category) { allFdnElems; }

# group: 0.형상추출
geometry = Element.Geometry(element=code_block_12)
code_block_13 = CodeBlock(i=geometry) { i[0][0]; }

# group: 1.하부면 추출
explode = Geometry.Explode(geometry=code_block_13)
normalAtParameter = Surface.NormalAtParameter(surface=explode)
Z = Vector.Z(vector=normalAtParameter)
code_block_14 = CodeBlock(i=Z) { i==-1; }
filterByBoolMask = List.FilterByBoolMask(list=explode, mask=code_block_14)

# group: 산출규칙: 수동입력값
code_block_15 = CodeBlock()
# ---------- code_block_15.designscript (13 lines) ----------
[
"C1",
"C2",
"C3",
"C4",
"VCF",
"D1",
"D2",
"GWL",
"LD",
"RE",
"G"
];
# ----------------------------------------
code_block_16 = CodeBlock()
# ---------- code_block_16.designscript (13 lines) ----------
[
0.1,
0.00,
0,
0,
1.15,
0.1,
0.2,
-1,
0.3,
0.12,
1
];
# ----------------------------------------
byKeysValues_2 = DesignScript.Builtin.Dictionary.ByKeysValues(keys=code_block_15, values=code_block_16)

# group: 하부면 하강 값
code_block_17 = CodeBlock(d=byKeysValues_2)
# ---------- code_block_17.designscript (6 lines) ----------
[
d["C1"],
d["C2"],
d["C3"],
d["C4"]
];
# ----------------------------------------
sum = Math.Sum(values=code_block_17)
code_block_18 = CodeBlock { -1*1000; }
mul = sum * code_block_18

# group: 2.하부면 하강
code_block_19 = CodeBlock(i=filterByBoolMask.in) { i[0]; }
translate = Geometry.Translate(geometry=code_block_19, zTranslation=mul)

# group: 하부면 offset 값
code_block_20 = CodeBlock(d=byKeysValues_2)
# ---------- code_block_20.designscript (4 lines) ----------
[
d["D1"],
d["D2"]
];
# ----------------------------------------
sum_2 = Math.Sum(values=code_block_20)
code_block_21 = CodeBlock { 1000; }
mul_2 = sum_2 * code_block_21

# group: 3.하부면 라인 오프셋
perimeterCurves = Surface.PerimeterCurves(surface=translate)
byJoinedCurves = PolyCurve.ByJoinedCurves(curves=perimeterCurves)
offsetMany = Curve.OffsetMany(curve=byJoinedCurves, signedDistance=mul_2)

# group: 하부면 elevation 값
code_block_22 = CodeBlock { "Elevation at Bottom"; }
getParameterValueByName_3 = Element.GetParameterValueByName(element=code_block_12, parameterName=code_block_22)

# group: 하부라인 상승 높이
code_block_23 = CodeBlock { -1; }
mul_3 = getParameterValueByName_3 * code_block_23

# group: 4.하부라인 상승(상부라인 생성)
translate_2 = Geometry.Translate(geometry=offsetMany, zTranslation=mul_3)

# group: 상부라인 offset 값
code_block_24 = CodeBlock(d=byKeysValues_2)
# ---------- code_block_24.designscript (3 lines) ----------
[
d["G"]
];
# ----------------------------------------
sum_3 = Math.Sum(values=code_block_24)
code_block_25 = CodeBlock(G=sum_3, H=mul_3) { G * H; }

# group: 5. 상부라인 오프셋
offsetMany_2 = Curve.OffsetMany(curve=translate_2, signedDistance=code_block_25)

# group: 6.토공형상 생성
code_block_26 = CodeBlock(상부라인=offsetMany_2) { 상부라인; }
code_block_27 = CodeBlock(하부라인=offsetMany) { 하부라인; }
join = List.Join(list0=code_block_26, list1=code_block_27)
byLoft = Solid.ByLoft(crossSections=join)
