# Dynamo graph [H_PAB.RT.Q2]_Revit 물량 산출_[3.0.1]_7주차실습용.dyn (Dynamo 2.16.1.2727)
# author: MK Jang
# Auto Calculating the Quantities of each Element As per the Family List

물량산출모드_입찰_실행 = CustomSelection("실행", items={입찰: "입찰", 실행: "실행"})  # graph input
lang_mode_영_한_select = BoolSelector(true)

# group: All Data In Excel
family_list_경로_입력 = Filename(".\[H_PAB.OD.L2]_BIM 팀 표준 패밀리 리스트_rev3(240502).xlsx")  # graph input
file_from_path = FileObject(path=family_list_경로_입력)
target_sheet_names = CodeBlock()
# ---------- target_sheet_names.designscript (18 lines) ----------
[
"WM-AR"
,"산출기준"
,"0.Room"
,"1.Floors"
,"2.Roofs"
,"3.Walls_Ext"
,"3.Walls_Int"
,"4.St_Fdn"
,"5.St_Col"
,"6.St_Framing"
,"7.Ceilings"
,"8.Doors"
,"9.Windows"
,"10.Stairs"
,"11.Railings"
,"12.Generic"
];
# ----------------------------------------
boolean = BoolSelector(true)
importExcel = Data.ImportExcel(file=file_from_path, sheetName=target_sheet_names, showExcel=boolean)

# group: All Elements in Revit
categories = Categories("OST_Rooms")
all_elements_of_category = ElementsOfCategory(Category=categories)
all_elementsexceptrails = Python()  # CPython3; unwired: IN[0]
# ---------- all_elementsexceptrails.python (51 lines) ----------
# Load the Python Standard and DesignScript Libraries
import sys
import clr
clr.AddReference('ProtoGeometry')
from Autodesk.DesignScript.Geometry import *

clr.AddReference('RevitAPI')
from Autodesk.Revit.DB import *
import Autodesk

clr.AddReference('RevitServices')
import RevitServices
from RevitServices.Persistence import DocumentManager
doc = DocumentManager.Instance.CurrentDBDocument

def get_all_BIC():

    db = [
    Autodesk.Revit.DB.BuiltInCategory.OST_Floors,
    Autodesk.Revit.DB.BuiltInCategory.OST_Roofs,
    Autodesk.Revit.DB.BuiltInCategory.OST_Walls,
    Autodesk.Revit.DB.BuiltInCategory.OST_StructuralFoundation,
    Autodesk.Revit.DB.BuiltInCategory.OST_StructuralColumns,
    Autodesk.Revit.DB.BuiltInCategory.OST_StructuralFraming,
    Autodesk.Revit.DB.BuiltInCategory.OST_Ceilings,
    Autodesk.Revit.DB.BuiltInCategory.OST_Doors,
    Autodesk.Revit.DB.BuiltInCategory.OST_Windows,
    Autodesk.Revit.DB.BuiltInCategory.OST_Stairs,
    #Autodesk.Revit.DB.BuiltInCategory.OST_Railings,
    ]
    return db
    
def get_allElems(doc):
    bics = get_all_BIC()
    
    def getElems(x):
        collector = FilteredElementCollector(doc)
        res = collector.OfCategory(x).WhereElementIsNotElementType().ToElements()
        return res

    def getRailElems(x):
        collector = FilteredElementCollector(doc)
        res = collector.OfCategory(x).WhereElementIsNotElementType()
        return res

    res = map(getElems, bics)
#    res = getRailElems(Autodesk.Revit.DB.BuiltInCategory.OST_RailingSystemRail)
    return res


OUT = get_allElems(doc)
# ----------------------------------------
categories_2 = Categories("OST_StairsRailing")
all_elements_of_category_2 = ElementsOfCategory(Category=categories_2)
list_create = List.Create(item0=all_elements_of_category_2)
categories_3 = Categories("OST_GenericModel")
all_elements_of_category_3 = ElementsOfCategory(Category=categories_3)
type = Object.Type(object=all_elements_of_category_3)
code_block = CodeBlock(i=type) { i!="Revit.Elements.DirectShape"; }
filterByBoolMask = List.FilterByBoolMask(list=all_elements_of_category_3, mask=code_block)
list_create_2 = List.Create(item0=filterByBoolMask.in)
join = List.Join(list0=all_elements_of_category, list1=all_elementsexceptrails, list2=list_create, list3=list_create_2)

# group: 모델링된 모든 객체의 패밀리 타입 명 추출 구간 (Room 객체의 경우 Number 속성값을 합쳐서 이름 추출)
code_block_2 = CodeBlock { "_"; }
flatten = List.Flatten(list=join)
type_2 = Object.Type(object=flatten)
code_block_3 = CodeBlock(i=type_2) { i=="Revit.Elements.Room"; }
filterByBoolMask_2 = List.FilterByBoolMask(list=flatten, mask=code_block_3)
code_block_4 = CodeBlock { "Number"; "Name"; }
getParameterValueByName = Element.GetParameterValueByName(element=filterByBoolMask_2.in, parameterName=code_block_4.out0)
getParameterValueByName_2 = Element.GetParameterValueByName(element=filterByBoolMask_2.in, parameterName=code_block_4.out1)
list_create_3 = List.Create(item0=getParameterValueByName, item1=getParameterValueByName_2)
transpose = List.Transpose(lists=list_create_3)
join_2 = String.Join(separator=code_block_2, string0=transpose)
code_block_5 = CodeBlock(i=join_2) { i[0]; }
code_block_6 = CodeBlock { "Type"; "Type Name"; }
getParameterValueByName_3 = Element.GetParameterValueByName(element=filterByBoolMask_2.out, parameterName=code_block_6.out0)
getParameterValueByName_4 = Element.GetParameterValueByName(element=getParameterValueByName_3, parameterName=code_block_6.out1)
join_3 = List.Join(list0=code_block_5, list1=getParameterValueByName_4)
list_create_4 = List.Create(item0=join_3, item1=flatten)

# group: Excel Dictionarize & 레빗 객체와 결합 딕셔너리 형성 및 심볼 / 값 추출
excel_data_dictionarization_3_0 = Python(IN[0]=lang_mode_영_한_select, IN[1]=importExcel, IN[2]=target_sheet_names, IN[3]=list_create_4)  # "Excel data dictionarization_3.0.2_new"; CPython3
# ---------- excel_data_dictionarization_3_0.python (556 lines) ----------
# Load the Python Standard and DesignScript Libraries"
import sys
import clr
clr.AddReference('ProtoGeometry')
from Autodesk.DesignScript.Geometry import *

################Module For Functional Programing#########################
from functools import reduce
from itertools import chain
from itertools import groupby
from copy import deepcopy
curry = lambda f: lambda a,*args: f(a, *args) if (len(args)) else lambda *args: f(a, *args)

filter = curry(filter)
map = curry(map)
reduce = curry(reduce)

go = lambda *args: reduce(lambda a,f: f(a), args) ## 함수도 축약 가능 ##

def dictUpdate(dic1,dic2):
    res = dic1.update(dic2)
    return dic1
    
def dictsMerge(dics):
    res = reduce(dictUpdate, dics)
    return res
    
def dictDeleteKeys(dic, keys):
    for k in keys:
        del dic[k]
    return dic

def flat(a):
    if isinstance(a, list):
        for i in a: 
            yield from flat(i)
    else: yield a
#########################################################################

import re
from functools import partial

# The inputs to this node will be stored as a list in the IN variables.
dataEnteringNode = IN
lang_mode = IN[0]
wholeDatas = IN[1]
db = wholeDatas[1:]
allCatSheetsNames = IN[2][2:]
allCatSheetsNames_noRoom = allCatSheetsNames[1:]

calcStdSheet = db[0] ##산출기준 시트
allCatSheets = db[1:]

allElemsNames = IN[3][0]
allElems = IN[3][1]
allElemsSet = list(zip(allElemsNames, allElems))


#wmspec_headers = [
#    "Work Master Code" ,"GaugeCode" ,"Unit" ,"Work Category-L1"
#    ,"Work Category-L2" ,"Work Category-L3" ,"Spec. 1- L4" ,"Spec. 2- L5"
#    ,"Spec. 3- L6" ,"Spec. 4- L7" ,"Spec. 5- L8" ,"Spec. 6- L9"
#    ,"Spec. 7- L10" ,"Spec. 8- L11" ,"BOQ Spec1" ,"BOQ Spec2" ,"BOQ Spec3"
#    ,"BOQ Spec4" ,"BOQ Spec5" ,"BOQ Spec6" ,"BOQ Spec7" ,"BOQ Spec8" ,"BOQ Spec9"
#    ,"Work Master Code /w Description", "Description" ,"입찰_물량산출식" ,"실행_물량산출식" ,"rIDX"
#]
# Place your code below this line

def find_IsInStr(target, string):
    if target == None or string == None:
        pass
    else:
        res = str(target) in str(string)
        return res

def find_range_by_columnItem(db, col_idx, sep_rule):
    tdb = list(map(lambda x: x[col_idx], db)) ##targetTransposedDB (col_idx에 해당하는 데이터만 추출)
    last_idx_tdb = len(tdb)-1
    tdb_enum = enumerate(tdb)
    target_RowNumber = list(filter(lambda x: find_IsInStr(sep_rule, x[1]), tdb_enum))
    endidxs_tmp= list(map(lambda x: x[0]-1,target_RowNumber))
    endidxs_tmp.pop(0)
    endidxs = endidxs_tmp + [last_idx_tdb] ## 각 구간별 마지막 행 번호
    rangeSttIdxs = list(map(lambda x: x[0]+1,target_RowNumber))
    rangeEndIdxs = endidxs
    result = list(zip(rangeSttIdxs, rangeEndIdxs))
    return result

    
def find_headersAtSheet(sheet):
    headers_sheet = list(map(lambda x: [x[1].replace("\n",""),x[0]], filter(lambda x: x[1] != None, enumerate(sheet[1]))))
    
    return dict(headers_sheet)
    #return list(headers_sheet)

def find_rangesAtSheet(sheet, hdrs_withIdxDict, trgt_hdr, trgt_str):
    #hdrs_withIdxDict = dict(hdrs_withIdx)
    return find_range_by_columnItem(sheet, hdrs_withIdxDict[trgt_hdr], trgt_str)


def get_DataOnGrpsAtSheet(sheet:list, discrHDRStr, discrRowStr):
    """
    판별기준 Header문자열(discrHDRStr)이 들어있는 열에서,
    판별기준 행 문자열(discrRowStr)이 들어있는 행번호 기준으로 구역을 나누어 데이터 리스트 반환
    """
    hdrs_withIdxDict = find_headersAtSheet(sheet)

    # 시트별 그룹 구분 (시작 행번호, 끝 행 번호 추출)
    rowAreasAtSheet = find_rangesAtSheet(sheet, hdrs_withIdxDict, discrHDRStr, discrRowStr)
    
    # 시트 각행에 rIDX 데이터 주입하는 구간 - (시작) >>>>>>>
    ## 헤더의 칼럼 인덱스 중 가장 큰 것 추출
    hdrs_maxCol_idx = max(list(hdrs_withIdxDict.values()))
    ## 마지막 헤더위치보다 한칸 옆을 행인덱스번호("rIDX") 정보 보관 위치로 설정
    hdrs_withIdxDict["rIDX"] = hdrs_maxCol_idx+1
    ## 시트의 각 행을 번호와 함께 pair 형태로 추출
    sheetWith_rIDX = list(enumerate(sheet))
    ## rIDX 보관된 시트 데이터 저장을 위한 빈 리스트 선언
    sheet_rIDX = []
    ## pair 형태의 각 행에서, 마지막 헤더의 한칸 우측위치에 rIDX 데이터 주입
    ## 시트의 각 행마다 x 라는 이름으로 순회하며,
    for x in sheetWith_rIDX:
        ### 행의 전체 데이터 길이가 마지막 헤더 위치보다 클때,
        if len(x)<hdrs_maxCol_idx:
            #### 마지막 헤더의 우측 칸 위치를 rIDX 데이터로 치환
            x[1][hdrs_maxCol_idx+1] = x[0]
            sheet_rIDX.append(x[1])
            
        ### 행의 전체 데이터 길이가 마지막 헤더 위치와 같을때,
        else:
            #### 마지막 헤더의 우측칸이 없으므로 append로 rIDX 데이터 추가
            x[1].append(x[0])
            sheet_rIDX.append(x[1])
    # <<<<< 시트 각행에 rIDX 데이터 주입하는 구간 - (끝)
    
    rowsGrps_perType_withNone = list(map(lambda x: sheet_rIDX[x[0]-1:x[1]], rowAreasAtSheet))
    # None 데이터 치환 구간
    rowsListGrps_perType = go(#>
        rowsGrps_perType_withNone, list,
        ## 하나의 타입을 규정하는 행들의 모임에서
        map(lambda rowGrp: \
        ## 한 행씩 골라서
        list(map(lambda row: \
        ## 행을 구성하는 셀 값 중 None이 있으면 빈문자열로 치환
        list(map(lambda cell: "" if cell==None else cell, row)), rowGrp)) ),
        ## 맵 객체가 반환되므로 리스트 변환
        list,
    )#<
    
    return (rowsListGrps_perType, hdrs_withIdxDict)

def cvt_rowsListGrps_toDictGrps(rowsListGrps_perType, hdrs_withIdxDict, sheetName):
    """
    헤더 행과 다수의 컨텐츠 행으로 이루어진 rowListGrps를,
    모든 행을 헤더와 결합된 딕셔너리화 해서 rowDictGrps를 만드는 함수
    """
    eff_hdrs_idx = hdrs_withIdxDict.values()
    eff_hdrs_name = hdrs_withIdxDict.keys()
    
    rowsDictGrps_perType = go(#>
        rowsListGrps_perType,
        ## 하나의 타입을 규정하는 행들의 모임에서 한 행 씩 조작하는 함수들을 구상 후
        ## 맵 함수 내에서 go로 합성하여 반복시켜 사용
        map(lambda rowGrp: go(#>>
            ### 그룹 전체 가져와서
            rowGrp,
            ### 각 행을 리스트 타입으로 변환
            map(list), list,
            ### 헤더에 해당하는 행 값을 추출--
            map(lambda row: list(map(lambda idx: row[idx], eff_hdrs_idx))), list,
            ### 헤더이름과 행 내부의 값을 2개씩 짝지어 줌
            map(lambda row: list(zip(eff_hdrs_name, row))), list,
            ### 헤더이름 : 값의 형태로 각 행 데이터를 딕셔너리로 만듬
            map(lambda x: dict(x)),
            ### 딕셔너리 마다 카테고리 정보 추가
            map(lambda x: dictUpdate(x,{"Family Category":sheetName})),
            list,
            )#<<
        ), list,
    )#<
    return rowsDictGrps_perType

# 행딕셔너리 별 입력한 규칙에 따라 참거짓 여부를 반환하는 함수
def findRow_AppliedType(rowDict, tgtHDRname, rule=None):
    p = re.compile('[0-9]{3,5}')
    target = str(rowDict[tgtHDRname])
    ## 함수 호출시 구분자(rule) 없이 호출한 경우
    ## -Room Category 시트 용 이며 "Standard Type" 항목의 값이 000형태의 숫자인지를 판별
    ## -Room Category 중 "Standard Type" 칼럼에 룸 넘버, "Family Type Name" 칼럼에 룸 이름 입력하게 되어있음
    if rule==None:
        p = re.compile('[0-9]{3,5}')
        m = p.match(target)
        stdCase = target =="Room No"
        res = all([m or stdCase])
    ## 구분자(rule)가 정규표현식 객체로 들어온 경우
    elif isinstance(rule, re.Pattern):
        m = p.match(target)
        res = all([m])
    ## 구분자(rule)가 문자열로 들어온 경우
    else:
        res = rule in target
    return res



def form_TypeDict(rowsDictGrps,titleKeyName,sttIdx):
    """
    rowsDictGrps_perType을 받아서 각 그룹의 이름을 키로 하는
    새로운 중첩구조의 Dictionary를 만들어서,
    바깥에서 타입이름으로 딕셔너리에 접근하면 
    바로 해당 구성내용을 반환해주는 데이터 구조를 만드는 함수
    """
    typeDict = go(#>
        rowsDictGrps, list,
        filter(lambda x: x!=[]),
        map(lambda rowsDictGrp: \
            ### 그룹 전체 첫행 중 타이틀키값과 나머지 row 들 dict를 짝지어 새로운 딕셔너리로 형성
            [list(rowsDictGrp)[0][titleKeyName],go(#>>
                list(rowsDictGrp)[sttIdx:],
                #### 모두 빈칸인 값일때 제외 필터링
                filter(lambda row: any(list(map(lambda cell: cell!="", list(row.values()))))),
                list,
            )]#<<
        ),list,
        dict,
    )#<
    
    return typeDict

def updateDict_symValPair(calcTypeDict):
    """
    calcTypeDict를 입력으로 받아서
    필요한 "약자-대응 항목" 의 구조를 갖는 딕셔너리 형태로
    구성된 새로운 Dictionary를 반환하는 함수
    """
    # 모든 산출타입 이름 추출
    allCalcTypeNames = list(calcTypeDict.keys())
    # 전체 결과물 담을 빈 딕셔너리 선언
    res = {}
    # 산출타입태그 이름 각각에 대해,
    for x in allCalcTypeNames:
        ## 타입별 약자 - 산출 대상 값 을 매칭하기위한 빈 딕셔너리 선언
        type = {}
        ## 산출기준 시트의 각 행을 딕셔너리화 한 rD마다 값을 들여다보며
        for rD in calcTypeDict[x]:
            ### 행 딕셔너리의 "수동 입력값" 항목의 값이 유효한 값이고,
            ###"산출수식 약자" 항목에도 유효한 값이 있다면
            if rD["수동 입력값"]!="" and rD["산출수식 약자"]!="":
                #### 신규 딕셔너리인 type에 키를 산축수식 약자로 하고,
                #### 값을 수동입력값이나 Parameter 항목 값으로 하는 딕셔너리 형성
                type[rD["산출수식 약자"]] = rD["수동 입력값"]
            elif rD["Parameter"]!="" and rD["산출수식 약자"]!="":
                type[rD["산출수식 약자"]] = rD["Parameter"]
        ## 전체를 담을 빈딕셔너리인 res에 
        ## 키를 산축수식 약자로 하고, 값을 아까 마련한 type 딕셔너리로 하는 딕셔너리로 만듬
        res[x] = type
    # 최종결과 반환
    return res
   

def find_stdWMdicts_inGrp(rowsDictGrp):
    res = go(
        rowsDictGrp, list,
        ## 엑셀 "물량산출식", "Work Master Code" 열에 값이 없는 행 제외
        filter(lambda rD: rD["입찰_물량산출식"] != "" and rD["실행_물량산출식"] != ""),
        filter(lambda rD: rD["Work Master Code"] != ""),
        ## Family Type Name에 "H_" 문자열 포함된 경우 제외
        filter(lambda rD: not findRow_AppliedType(rD, "Family Type Name", rule="H_")),
        ## 행 딕셔너리의 NO, Standard Type 업데이트
        map(lambda rD: dictUpdate(rD,{"NO":rowsDictGrp[0]["NO"], "Standard Type":rowsDictGrp[0]["Standard Type"]})),
        ## Q'ty Cal Type Tag 업데이트
        map(lambda rD: dictUpdate(rD,{"Q'ty Cal Type Tag":rowsDictGrp[0]["Q'ty Cal Type Tag"]})),
        list,
    )
    return res


def find_stdWMdicts_forCat(rowsDictsGrps):
    res = go(#>
        rowsDictsGrps, list,
        map(find_stdWMdicts_inGrp),
        #filter(lambda x: x!=[]),
        list,
    )#<
    return res

def find_appliedTypeDicts_forCat(rowsDictsGrps):
    catName = rowsDictsGrps[0][0]["Family Category"]
    eff_hdrs_name = list(rowsDictsGrps[0][0].keys())
    wmspec_headers = ["Family Category", "Work Master Code", "GaugeCode", "Unit"]\
        + list(filter(lambda x: "Work Cat" in x or "Spec" in x, eff_hdrs_name))\
        + ["Work Master Code /w Description", "Description","입찰_물량산출식", "실행_물량산출식", "rIDX"]
    #stdWMsDicts = find_stdWMdicts_forCat(rowsDictGrps)
    
    appliedTypeDicts = go(#>
        rowsDictsGrps,
        map(lambda rowsDictsGrp: go(#>>
            rowsDictsGrp, list,
            ## Family Type Name에 "H_" 문자열 포함된 경우만 필터링
            filter(lambda rD: findRow_AppliedType(rD, "Family Type Name", rule="H_")),
            ## 행 딕셔너리의 NO, Standard Type 업데이트 - 추후 함수 분리 염두
            map(lambda rD: dictUpdate(rD,{"NO":rowsDictsGrp[0]["NO"], "Standard Type":rowsDictsGrp[0]["Standard Type"]})),
            ## 그룹 첫행을 기준으로 Q'ty Cal Type Tag 업데이트 - 추후 함수 분리 염두
            map(lambda rD: dictUpdate(rD,{"Q'ty Cal Type Tag":rowsDictsGrp[0]["Q'ty Cal Type Tag"]})),
            
            # wmSpecs 속성들을 헤더로 하는 새로운 딕셔너리 형성 및 값 추가(값은 list형태)
            map(lambda rD: dictUpdate(rD, {"wmSpecs": go(
                ### wmspec관련 항목들 값을 리스트로 모음
                map(lambda x: rD[x], wmspec_headers), list,
                ### 항목명과 항목값을 모아서 딕셔너리 형태로 변환
                lambda x: zip(wmspec_headers,x), dict,
                ### wmSpecs 항목을 리스트 구조로 수정해 두기
                lambda x: [x] if x["Work Master Code"]!="" else [],
                
            )}) ),
            ## 밖으로 꺼내진 WorkMaster 관련 속성 삭제
            map(lambda rD: dictDeleteKeys(rD, wmspec_headers)), list,
            ## 각 딕셔너리마다 카테고리 명 입력
            #map(lambda rD: dictUpdate(rD, {"Family Category":catName})),
            list,
            )#<<
        ),
        # 실적용 패밀리타입이 없는 그룹은 제외하는 구간
        filter(lambda x: list(x)!=[]),
        list,
    )#<
    
    return appliedTypeDicts

def find_appliedTypeDicts_forRoom(rowsDictsGrps):
    eff_hdrs_name = list(rowsDictsGrps[0][0].keys())
    wmspec_headers = ["Family Category", "Work Master Code", "GaugeCode", "Unit"]\
        + list(filter(lambda x: "Work Cat" in x or "Spec" in x, eff_hdrs_name))\
        + ["Work Master Code /w Description", "Description","입찰_물량산출식", "실행_물량산출식", "rIDX"]
    
    appliedTypeDicts = go(#>
        rowsDictsGrps,
        map(lambda rowsDictsGrp: go(#>>
            rowsDictsGrp, list,
            ## Standard Type 에 "H_" 문자열 포함된 경우만 필터링(only for room)
            filter(lambda rD: findRow_AppliedType(rD, "Standard Type")),
            ## 행 딕셔너리의 NO, Standard Type 업데이트 - 추후 함수 분리 염두
            map(lambda rD: dictUpdate(rD,{"NO":rD["Standard Type"], "Standard Type":rowsDictsGrp[0]["Standard Type"]})),
            ## 그룹 첫행을 기준으로 Q'ty Cal Type Tag 업데이트 - 추후 함수 분리 염두
            map(lambda rD: dictUpdate(rD,{"Q'ty Cal Type Tag":rowsDictsGrp[0]["Q'ty Cal Type Tag"]})),
            
            # wmSpecs 속성들을 헤더로 하는 새로운 딕셔너리 형성 및 값 추가(값은 list형태)
            map(lambda rD: dictUpdate(rD, {"wmSpecs": go(
                ### wmspec관련 항목들 값을 리스트로 모음
                map(lambda x: rD[x], wmspec_headers), list,
                ### 항목명과 항목값을 모아서 딕셔너리 형태로 변환
                lambda x: zip(wmspec_headers,x), dict,
                ### wmSpecs 항목을 리스트 구조로 수정해 두기
                lambda x: [x] if x["Work Master Code"]!="" else [],
                
            )}) ),
            ## 밖으로 꺼내진 WorkMaster 관련 속성 삭제
            map(lambda rD: dictDeleteKeys(rD, wmspec_headers)), list,
            
            ## Room 의 경우는 "No"와 "Family Type Name"을 합쳐서 "Family Type Name"에 입력
            map(lambda rD: dictUpdate(rD,{"Family Type Name":str(rD["NO"]).split('.')[0]+"_"+rD["Family Type Name"]})),
            
            list,
            )#<<
        ),
        # 실적용 패밀리타입이 없는 그룹은 제외하는 구간
        filter(lambda x: list(x)!=[]),
        list,
    )#<
    
    return appliedTypeDicts

def merge_sameFamType_wmSpecs(appliedTypeDicts):
    def merge_inGrp(appliedTypeDicts_perGrp):
        """
        엑셀 타입별 행그룹 내에서 실 적용 패일리명이 들어있는
        행들만 추출하고, 그 중 이름이 같은 것들의 wm 정보는 합쳐서
        하나의 이름에 하나의 딕셔너리 객체만 존재하도록 수정
        """
        ## 그룹 내 실 적용 패밀리 타입 명 추출(중복 불허)
        keysPerGrp = go(#>
            appliedTypeDicts_perGrp,
            ## 개별 행딕셔너리의 패밀리 타입 항목 값 추출
            map(lambda rD: rD["Family Type Name"]),
            ## 문자열 내 "H_"가 포함되어있는 지 검사
            filter(lambda x: "H_" in x),
            ## 중복 Family Type Name 단일화
            set, list,
        )#<
        ## 패밀리 타입 명을 k라는 변수명으로 하나씩 순회
        for k in keysPerGrp:
            ### k라는 패밀리 타입 명에 해당하는 딕셔너리 모두 검색
            sameNameDicts = list(filter(lambda x: x["Family Type Name"] == k, appliedTypeDicts_perGrp))
            ### 하나의 타입명에 복수 객체인지를 검사하여
            ### 2개 이상인 경우
            if len(sameNameDicts)>=2:
                ### 동일 이름의 딕셔너리들 중 첫번째 항목의 "wmSpecs"에
                ### 나머지 항목의 wmSpecs 항목을 몰아준다
                for i,rD in enumerate(sameNameDicts[1:]):
                    if rD["wmSpecs"]:
                        sameNameDicts[0]["wmSpecs"].append(*rD["wmSpecs"])
                    else: pass
                ### 몰아주기가 끝나면, 첫번째를 제외한 나머지 딕셔너리는
                ### 불필요해지므로 삭제
                appliedTypeDicts_perGrp.remove(sameNameDicts[i+1])
            else:                
                pass
        ## 수정된 딕셔너리들 리스트를 반환
        return appliedTypeDicts_perGrp
    # 단위 그룹에 대한 함수를 복수 그룹들 전체에 시행
    return map(merge_inGrp, appliedTypeDicts)



def inject_stdWMtoAppliedTypeDicts(appliedTypeDicts, allCat_stdWMdicts_stdTypeName):
    def inject_inGrp(appliedTypeDict_perGrp):
        """
        타입 그룹 별 공통 WM 딕셔너리 항목들을
        실적용패밀리 딕셔너리에 주입하는 함수
        """
        ## 실적용패밀리 딕셔너리 리스트의 구성 원소 각각을
        ## rD(rowDictionary) 라는 이름으로 순회
        for rD in appliedTypeDict_perGrp:
            ### rD의 "Standard Type" 항목 값이
            ### 입력받은 타입별 공통 WM항목 딕셔너리의 키값중에
            ### 포함되었는지 검사후 있으면,
            if rD["Standard Type"] in list(allCat_stdWMdicts_stdTypeName.keys()):
                #### rD의 "wmSpecs" 항목에 공통 WM항목을 추가하여 재할당
                rD["wmSpecs"] = rD["wmSpecs"] + allCat_stdWMdicts_stdTypeName[rD["Standard Type"]]
            else:
                pass
        ## 수정된 딕셔너리들 리스트를 반환
        return appliedTypeDict_perGrp
    # 단위 그룹에 대한 함수를 복수 그룹들 전체에 시행
    return list(map(inject_inGrp, appliedTypeDicts))
    
def updateFamTypeDicts_symValPair(total_appliedTypeDicts, calcTypeDict_symValPair):
    """
    실적용패밀리타입명 별 딕셔너리에
    "Q'ty Cal Type Tag" 항목 값 이름과 일치하는
    물량산출 매개변수 꾸러미 추가하는 함수
    """
    # 전체 결과물 담을 빈 딕셔너리 선언
    res = {}
    # 전체 실적용 패밀리 딕셔너리들 중 구성원소 각각을 d라는 이름으로 순회
    for d in total_appliedTypeDicts:
        ## 딕셔너리의 "Q'ty Cal Type Tag"항목의 값이 빈문자열이 아니라면,
        if d["Q'ty Cal Type Tag"]!="":
            ### 딕셔너리에 "Sym_Val Dict"라는 키를 추가하고
            ### calcTypeDict 중 일치하는 값을 골라 키의 값으로 할당
            symValPair = calcTypeDict_symValPair[d["Q'ty Cal Type Tag"]]
            d["Sym_Val Dict"] = symValPair
        ## 전체용 빈 딕셔너리에 패밀리 타입명을 키로 추가하고
        ## 방금 수정한 단위 딕셔너리를 키의 값으로 할당
        res[d["Family Type Name"]] = d    
    return res
    
def matchWith_Elem_Dict(famlist_dic,revitElems):
    """
    레빗객체와 패밀리리스트 딕셔너리의 정보를 하나로 결합해주는 용도의 함수
    패밀리리스트 데이터는 패밀리 타입명을 키값으로 하는 하나의 딕셔너리로 정리되어있어야 한다
    revit객체는 패밀리리스트 상 존재하는 타입만 필터링해서 입력해야 함
    """
    # 수행결과를 모을 빈 리스트 선언
    res = []
    # 모든 레빗 객체들을 하나씩 순회 
    for i in revitElems:
        ## revit 객체들과 revit 타입별 Family List 딕셔너리를 결합하기 위한 빈 딕셔너리 선언
        combD = {}
        ## 패밀리 타입명 추출 - Room 객체인 경우와 아닌 경우 분기
        if "Room" in str(type(i)):
            famTypeName = i.GetParameterValueByName("Number") + "_" + i.GetParameterValueByName("Name")
        else:
            famTypeName = i.GetParameterValueByName("Type").GetParameterValueByName("Type Name")
        ## 결합용 딕셔너리의 "Elem" 이라는 키에 순회 중인 i (revit객체)를 할당
        combD["Elem"] = i
        combD["GUID"] = i.GetParameterValueByName("IfcGUID")
        ## 결합용 딕셔너리의 "wms" 이라는 키에 
        ## 순회 중인 i (revit객체) 패밀리 타입 명과 일치하는 famlist_dictionary의 값을 할당
        combD["wms"] = deepcopy(famlist_dic[famTypeName])
        ##결합된 딕셔너리를 res에 저장
        res.append(combD)
    # 전체 수행 결과 반환
    return res

def update_sym_valDict(matched_elemDicts):
    def update_sym_valDict_single(d):
        """
        딕셔너리별로 포함된 ["wms"]["Sym_Val Dict"]항목 내에
        아직 계산되지 않은 매개변수 값들을 계산하여
        "Post_Sym_Val Dict"라는 새로운 키의 값으로 할당하는 함수
        """
        e = d["Elem"]
        newSymValDict = {}
        keys = d["wms"]["Sym_Val Dict"].keys()
        vals = d["wms"]["Sym_Val Dict"].values()
        for s,v in zip(keys, vals):
            ## Vals 항목이 사용자 입력값이 아닌 revit 매개변수인 경우
            if isinstance(v,str):
                if v not in list(map(lambda x: x.Name, e.Parameters)):
                    calc_v = e.ElementType.GetParameterValueByName(v)
                else:
                    calc_v = e.GetParameterValueByName(v)
                calc_vv= calc_v if isinstance(calc_v, str) else round(calc_v, 3)
                newSymValDict[s] = calc_vv
            ## Vals 항목이 사용자 입력값인 경우는 그대로 입력된 숫자 사용
            else:
                newSymValDict[s] = v
        d["wms"]["Post_Sym_Val Dict"] = newSymValDict
        
        return d
    return list(map(update_sym_valDict_single, matched_elemDicts))



    
calcSheet_rowsListGrps_perType = get_DataOnGrpsAtSheet(calcStdSheet, "구간판별", "#")
calcSheet_rowsDictGrps_perType = cvt_rowsListGrps_toDictGrps(*calcSheet_rowsListGrps_perType,"")
calcTypeDict = form_TypeDict(calcSheet_rowsDictGrps_perType,"Q'ty Cal Type Tag",sttIdx=1)
calcTypeDict_symValPair = updateDict_symValPair(calcTypeDict)

roomSheet_rowsListGrps_perType = get_DataOnGrpsAtSheet(allCatSheets[0], "Standard Type", "H_")
roomSheet_rowsDictGrps_perType = cvt_rowsListGrps_toDictGrps(*roomSheet_rowsListGrps_perType,"0.Room")
room_stdWMdicts = find_stdWMdicts_forCat(deepcopy(roomSheet_rowsDictGrps_perType))
room_stdWMdicts_stdTypeName = form_TypeDict(room_stdWMdicts, "Standard Type",sttIdx=0)

room_appliedTypeDicts = find_appliedTypeDicts_forRoom(roomSheet_rowsDictGrps_perType)
room_appliedTypeDicts_noDupl = merge_sameFamType_wmSpecs(room_appliedTypeDicts)

room_appliedTypeDicts_withStdWm = list(chain(*inject_stdWMtoAppliedTypeDicts(room_appliedTypeDicts_noDupl, room_stdWMdicts_stdTypeName)))

# 룸 제외 모든 카테고리 시트 처리
allCatSheet_rowsListGrps = map( lambda x: get_DataOnGrpsAtSheet(x, "Standard Type", "H_"), allCatSheets[1:] )
allCatSheet_rowsListGrps_namesPair = list(zip(allCatSheet_rowsListGrps, allCatSheetsNames_noRoom))
allCatSheet_rowsDictGrps = map( lambda x: cvt_rowsListGrps_toDictGrps(*x[0],x[1]), allCatSheet_rowsListGrps_namesPair )

# "Standard Type" 별 wm 공통항목 찾기
allCat_stdWMdicts = list(map( lambda x: find_stdWMdicts_forCat(x), deepcopy(allCatSheet_rowsDictGrps) ))
# "Standard Type" 명으로 검색할 수 있는, 전 카테고리 "Standard Type" 별 공통 WM항목 사전 만들기
allCat_stdWMdicts_stdTypeName = dictsMerge(list(map(lambda x: form_TypeDict(x, "Standard Type",sttIdx=0), allCat_stdWMdicts)))

allCat_appliedTypeDicts = map( lambda x: find_appliedTypeDicts_forCat(x), allCatSheet_rowsDictGrps )
allCat_appliedTypeDicts_noDupl = map( lambda x: merge_sameFamType_wmSpecs(x), allCat_appliedTypeDicts )

allCat_appliedTypeDicts_withStdWm = list(chain(*chain(*map( lambda x: inject_stdWMtoAppliedTypeDicts(x,allCat_stdWMdicts_stdTypeName), allCat_appliedTypeDicts_noDupl ))))

total_appliedTypeDicts = room_appliedTypeDicts_withStdWm + allCat_appliedTypeDicts_withStdWm
FamTypeDicts_symValPair = updateFamTypeDicts_symValPair(total_appliedTypeDicts,calcTypeDict_symValPair)

allUsedFamTypeNames_Excel = FamTypeDicts_symValPair.keys()
allElemsFiltered_byExcel = list(map(lambda y: y[1], list(filter(lambda x: x[0] in allUsedFamTypeNames_Excel , allElemsSet))))

allElemsDict = update_sym_valDict(matchWith_Elem_Dict(FamTypeDicts_symValPair, allElemsFiltered_byExcel))
# Assign your output to the OUT variable.

OUT = allElemsDict, FamTypeDicts_symValPair
# ----------------------------------------
code_block_7 = CodeBlock(i=excel_data_dictionarization_3_0) { i; }
allElemsDict = CodeBlock(i=code_block_7) { i[0]; }
allElemsDict_2 = CodeBlock(dictionarizedTypes=allElemsDict) { dictionarizedTypes; }
allTypes = CodeBlock(i=code_block_7) { i[1]; }

# group: Final Calculation
code_block_8 = CodeBlock(calcMode=물량산출모드_입찰_실행) { calcMode; }
토공관련_wm들_물량산출_수식_임시처리구간 = Python(IN[0]=allElemsDict_2)  # CPython3
# ---------- 토공관련_wm들_물량산출_수식_임시처리구간.python (56 lines) ----------
# Load the Python Standard and DesignScript Libraries
import sys
import clr
clr.AddReference('ProtoGeometry')
from Autodesk.DesignScript.Geometry import *

################Module For Functional Programing##########################
from functools import reduce
from itertools import chain
from itertools import groupby
from copy import deepcopy
curry = lambda f: lambda a,*args: f(a, *args) if (len(args)) else lambda *args: f(a, *args)

filter = curry(filter)
map = curry(map)
reduce = curry(reduce)

go = lambda *args: reduce(lambda a,f: f(a), args) ## 함수도 축약 가능 ##

def dictUpdate(dic1,dic2):
    res = dic1.update(dic2)
    #res = {**dic1,**dic2}
    return dic1 #res
    
def dictsMerge(dics):
    res = reduce(dictUpdate, dics)
    return res
    
def dictDeleteKeys(dic, keys):
    for k in keys:
        del dic[k]
    return dic
##########################################################################

# The inputs to this node will be stored as a list in the IN variables.
dataEnteringNode = IN
elemDicts = IN[0]
#test_sample = elemDicts[303]

# Place your code below this line

def tmp_switchEarthworkFormula(elemDict):
    
    for i in elemDict["wms"]["wmSpecs"]:
        calcFormulas = filter(lambda x: "산출식" in x ,list(i.Keys))
        for k in calcFormulas:
            if i[k] in ["=Exca", "=Back", "=Disp"]:
                i[k] = "_tbd"
        
    return elemDict

def tmp_switchEarthworkFormula_allDicts(elemDicts):
    return list(map(tmp_switchEarthworkFormula, elemDicts))

# Assign your output to the OUT variable.
OUT = tmp_switchEarthworkFormula_allDicts(elemDicts)
# ----------------------------------------
부재_wm_별_산식에_의한_최종_계산 = Python(IN[0]=code_block_8, IN[1]=토공관련_wm들_물량산출_수식_임시처리구간)  # CPython3
# ---------- 부재_wm_별_산식에_의한_최종_계산.python (98 lines) ----------
# Load the Python Standard and DesignScript Libraries
import sys
import clr

clr.AddReference('RevitAPI')
from Autodesk.Revit.DB import *
import Autodesk

clr.AddReference('RevitNodes')
import Revit
clr.ImportExtensions(Revit.Elements)

clr.AddReference('RevitServices')
import RevitServices
from RevitServices.Persistence import DocumentManager
from RevitServices.Transactions import TransactionManager
doc = DocumentManager.Instance.CurrentDBDocument
uiapp = DocumentManager.Instance.CurrentUIApplication
app = uiapp.Application
#collector1 = FilteredElementCollector(doc)

clr.AddReference('ProtoGeometry')
from Autodesk.DesignScript.Geometry import *

################Module For Functional Programing##########################
from functools import reduce
from itertools import chain
from itertools import groupby
from copy import deepcopy
curry = lambda f: lambda a,*args: f(a, *args) if (len(args)) else lambda *args: f(a, *args)

filter = curry(filter)
map = curry(map)
reduce = curry(reduce)

go = lambda *args: reduce(lambda a,f: f(a), args) ## 함수도 축약 가능 ##

def dictUpdate(dic1,dic2):
    res = dic1.update(dic2)
    #res = {**dic1,**dic2}
    return dic1 #res
    
def dictsMerge(dics):
    res = reduce(dictUpdate, dics)
    return res
    
def dictDeleteKeys(dic, keys):
    for k in keys:
        del dic[k]
    return dic
##########################################################################
# The inputs to this node will be stored as a list in the IN variables.
dataEnteringNode = IN

calcMode = IN[0]
elemDicts = IN[1]


# Place your code below this line

def calcFormula_each_WmSpecs(elemDicts, calcMode):
    calc_key = "실행_물량산출식" if calcMode=="실행" else "입찰_물량산출식"
    
    def calcFormula_dict(d):
        e = d["Elem"]
        postSymValDict = d["wms"]["Post_Sym_Val Dict"]
        Sym_Vals = list(zip(postSymValDict.Keys, list(map(str, postSymValDict.Values))))
        sortedSym_Vals = sorted(Sym_Vals, key=lambda x: len(x[0]), reverse=True)
        wmSpecss = d["wms"]["wmSpecs"]
        for i in wmSpecss:
            applyFormula = i[calc_key]
            if not applyFormula.startswith('_'):
                substFormula = applyFormula
                for x in sortedSym_Vals:
                    substFormula = substFormula.replace(*x)
                i["applyFormula"] = "'"+ applyFormula
                i["substFormula"] = "'"+ substFormula
                try:
                    i["Quantity"] = round(eval(substFormula.strip('=')),3)
                except:
                    i["Quantity"] = "'"+ substFormula
            else:
                i["applyFormula"] = "'"+ applyFormula
                i["substFormula"] = "'"+ applyFormula
                i["Quantity"] = ""
        return d
    
    res = []
    for d in elemDicts:
        res.append(calcFormula_dict(d))
    
    return res




# Assign your output to the OUT variable.
OUT = calcFormula_each_WmSpecs(elemDicts, calcMode)
# ----------------------------------------

parameters = Element.Parameters(element=join)
keys = DesignScript.Builtin.Dictionary.Keys()  # unwired: dictionary
code_block_9 = CodeBlock(i=allElemsDict) { i[99]; }
keys_2 = DesignScript.Builtin.Dictionary.Keys(dictionary=code_block_9)
code_block_10 = CodeBlock(i=code_block_9) { i["GUID"]; }
code_block_11 = CodeBlock(i=code_block_9) { i["wms"]; }
code_block_12 = CodeBlock(i=code_block_11) { i["Q'ty Cal Type Tag"]; }
code_block_13 = CodeBlock(i=code_block_11) { i["Quantity"]; }
code_block_14 = CodeBlock(i=code_block_11) { i["wmSpecs"]; }
keys_3 = DesignScript.Builtin.Dictionary.Keys(dictionary=code_block_14)
code_block_15 = CodeBlock(i=code_block_14) { i["Work Master Code"]; }
code_block_16 = CodeBlock(i=code_block_14) { i["실행_물량산출식"]; }
code_block_17 = CodeBlock { "="; }
split = String.Split(string=code_block_16, separator0=code_block_17)
flatten_2 = List.Flatten(list=split)
code_block_18 = CodeBlock(i=code_block_11) { i["Sym_Val Dict"]; }
keys_4 = DesignScript.Builtin.Dictionary.Keys(dictionary=code_block_18)
toLower = String.ToLower(string=keys_4)
code_block_19 = CodeBlock(i=code_block_9) { i["Elem"]; }
values = DesignScript.Builtin.Dictionary.Values(dictionary=code_block_18)
type_3 = Object.Type(object=values)
code_block_20 = CodeBlock(i=type_3) { i=="System.String"; }
filterByBoolMask_3 = List.FilterByBoolMask(list=values, mask=code_block_20)
getParameterValueByName_5 = Element.GetParameterValueByName(element=code_block_19, parameterName=filterByBoolMask_3.in)
code_block_21 = CodeBlock(value=values) { value; }
code_block_22 = CodeBlock { true; }
allIndicesOf = List.AllIndicesOf(list=code_block_20, item=code_block_22)
sym_val_dict_계산통합 = Python(IN[0]=getParameterValueByName_5, IN[1]=code_block_21, IN[2]=allIndicesOf)  # CPython3
# ---------- sym_val_dict_계산통합.python (20 lines) ----------
# Load the Python Standard and DesignScript Libraries
import sys
import clr
clr.AddReference('ProtoGeometry')
from Autodesk.DesignScript.Geometry import *

# The inputs to this node will be stored as a list in the IN variables.
dataEnteringNode = IN

대입값 = IN[0]
srcList = IN[1]
indexes = IN[2]
# Place your code below this line
res = []

for n,i in enumerate(indexes):
    srcList[i] = 대입값[n]

# Assign your output to the OUT variable.
OUT = srcList
# ----------------------------------------
evaluateFormula = Math.EvaluateFormula(formulaString=flatten_2, parameters=toLower, arguments=sym_val_dict_계산통합)
실행물량_산출식 = CodeBlock { "3 * a + 2*B"; }
sym_val_dict의_키값들 = CodeBlock()
# ---------- sym_val_dict의_키값들.designscript (4 lines) ----------
[
"a",
"b"
];
# ----------------------------------------
sym_val_dict의_계산값_혹은_입력값 = CodeBlock()
# ---------- sym_val_dict의_계산값_혹은_입력값.designscript (4 lines) ----------
[
7,
9
];
# ----------------------------------------
code_block_23 = CodeBlock(i=code_block_14) { i["Unit"]; }
