# Dynamo graph 8주차_jsonToexcel 추출 실습.dyn (Dynamo 2.16.1.2727)

file_path = Filename(".\sample_json.txt")
file_from_path = FileObject(path=file_path)
readText = FileSystem.ReadText(file=file_from_path)
parseJSON = Data.ParseJSON(json=readText)
code_block = CodeBlock(i=parseJSON) { i["wms"]["wmSpecs"]; }
code_block_2 = CodeBlock(i=code_block) { i["GaugeCode"]; }
code_block_3 = CodeBlock(i=code_block) { i["Spec. 1- L4"]; }
code_block_4 = CodeBlock(i=code_block) { i["Spec. 2- L5"]; }
code_block_5 = CodeBlock(i=code_block) { i["Spec. 3- L6"]; }
code_block_6 = CodeBlock(i=code_block) { i["Work Master Code"]; }
flatten = List.Flatten(list=code_block_6)
code_block_7 = CodeBlock(i=parseJSON) { i["wms"]["Family Type Name"]; }
count = List.Count(list=code_block@L2)
cycle = List.Cycle(list=code_block_7, amount=count, lacing=Shortest)
code_block_8 = CodeBlock(i=parseJSON) { i[0]; }
file_path_2 = Filename(".\BOQ_sample.xlsx")
code_block_9 = CodeBlock { "(AR) BOQ View (Working)"; 6; 0; }
code_block_10 = CodeBlock { [6,6,6]; 0..2; }
code_block_11 = CodeBlock(a=parseJSON) { a["wms"]["wmSpecs"]["Work Master Code"]; }
flatten_2 = List.Flatten(list=code_block_11)
code_block_12 = CodeBlock(a=parseJSON) { a["wms"]["wmSpecs"]["GaugeCode"]; }
flatten_3 = List.Flatten(list=code_block_12)
code_block_13 = CodeBlock { "|"; }
code_block_14 = CodeBlock(a=parseJSON) { a["wms"]["wmSpecs"]; }
code_block_15 = CodeBlock(i=code_block_14) { i["Spec. 1- L4"]; }
string_from_object = FromObject(object=code_block_15)
flatten_4 = List.Flatten(list=string_from_object)
code_block_16 = CodeBlock(i=code_block_14) { i["Spec. 2- L5"]; }
string_from_object_2 = FromObject(object=code_block_16)
flatten_5 = List.Flatten(list=string_from_object_2)
code_block_17 = CodeBlock(i=code_block_14) { i["Spec. 3- L6"]; }
string_from_object_3 = FromObject(object=code_block_17)
flatten_6 = List.Flatten(list=string_from_object_3)
list_create = List.Create(item0=flatten_4, item1=flatten_5, item2=flatten_6)
transpose = List.Transpose(lists=list_create)
join = String.Join(separator=code_block_13, string0=transpose)
flatten_7 = List.Flatten(list=join)
list_create_2 = List.Create(item0=flatten_2, item1=flatten_3, item2=flatten_7)
exportToExcel = Data.ExportToExcel(filePath=file_path_2, sheetName=code_block_9.out0, startRow=code_block_10.out0@L1, startColumn=code_block_10.out1@L1, data=list_create_2@L2)
