# Dynamo graph 입찰툴 결과 정리기.dyn (Dynamo 2.16.1.2727)

categories = Categories("OST_StructuralColumns")
all_elements_of_category = ElementsOfCategory(Category=categories)
categories_2 = Categories("OST_StructuralFoundation")
all_elements_of_category_2 = ElementsOfCategory(Category=categories_2)
code_block = CodeBlock(i=all_elements_of_category_2) { i; }
code_block_2 = CodeBlock { "Family and Type"; }
getParameterValueByName = Element.GetParameterValueByName(element=code_block, parameterName=code_block_2)
string_from_object = FromObject(object=getParameterValueByName)
code_block_3 = CodeBlock { "SOG"; }
contains = String.Contains(string=string_from_object, searchFor=code_block_3)
filterByBoolMask = List.FilterByBoolMask(list=code_block, mask=contains)
code_block_4 = CodeBlock(i=filterByBoolMask.in) { i[0]; }
setGeometryJoinOrder = Element.SetGeometryJoinOrder(cuttingElement=all_elements_of_category, otherElement=code_block_4, lacing=CrossProduct)
joinGeometry = Element.JoinGeometry()  # frozen; unwired: element, otherElement
joinGeometry_2 = Element.JoinGeometry(lacing=CrossProduct)  # frozen; unwired: element, otherElement
code_block_5 = CodeBlock(i=all_elements_of_category) { i; }
code_block_6 = CodeBlock { "Family and Type"; }
getParameterValueByName_2 = Element.GetParameterValueByName(element=code_block_5, parameterName=code_block_6)
string_from_object_2 = FromObject(object=getParameterValueByName_2)
code_block_7 = CodeBlock { "UG"; }
contains_2 = String.Contains(string=string_from_object_2, searchFor=code_block_7)
filterByBoolMask_2 = List.FilterByBoolMask(list=code_block_5, mask=contains_2)

# group: UG Peds
ug_peds = CodeBlock(ug=filterByBoolMask_2.in) { ug; }

# group: AG Columns
ag_cols = CodeBlock(ag=filterByBoolMask_2.out) { ag; }

joinGeometry_3 = Element.JoinGeometry(element=ug_peds, otherElement=ag_cols)  # frozen
parameters = Element.Parameters(element=all_elements_of_category_2)
categories_3 = Categories("OST_StructuralFraming")
all_elements_of_category_3 = ElementsOfCategory(Category=categories_3)
code_block_8 = CodeBlock(i=all_elements_of_category_3) { i; }
code_block_9 = CodeBlock { "Family and Type"; }
getParameterValueByName_3 = Element.GetParameterValueByName(element=code_block_8, parameterName=code_block_9)
string_from_object_3 = FromObject(object=getParameterValueByName_3)
code_block_10 = CodeBlock { "TG"; }
contains_3 = String.Contains(string=string_from_object_3, searchFor=code_block_10)
filterByBoolMask_3 = List.FilterByBoolMask(list=code_block_8, mask=contains_3)

# group: UG tiegirders
ug_tiegirders = CodeBlock(ug=filterByBoolMask_3.in) { ug; }

joinGeometry_4 = Element.JoinGeometry(element=ug_peds, otherElement=ug_tiegirders)  # frozen

# group: AG Beams
ag_beam_girders = CodeBlock(ag=filterByBoolMask_3.out) { ag; }

joinGeometry_5 = Element.JoinGeometry(element=ag_cols, otherElement=ag_beam_girders)  # frozen
joinGeometry_6 = Element.JoinGeometry(element=filterByBoolMask.in, lacing=CrossProduct)  # unwired: otherElement
