# Dynamo graph doormarksetup.dyn (Dynamo 2.16.1.2727)

categories = Categories("OST_Doors")
all_elements_of_category = ElementsOfCategory(Category=categories)
code_block = CodeBlock { "Mark"; }
categories_2 = Categories("OST_Doors")
all_elements_of_category_2 = ElementsOfCategory(Category=categories_2)
code_block_2 = CodeBlock { "Mark"; }
getParameterValueByName = Element.GetParameterValueByName(element=all_elements_of_category_2, parameterName=code_block_2)
code_block_3 = CodeBlock(i=getParameterValueByName) { "FRD-" + i; }
setParameterByName = Element.SetParameterByName(element=all_elements_of_category@L2, parameterName=code_block, value=code_block_3@L2)
