# Dynamo graph 패밀리타입이름수정기.dyn (Dynamo 2.16.1.2727)

python_script = Python()  # CPython3; unwired: IN[0]
# ---------- python_script.python (60 lines) ----------
# Load the Python Standard and DesignScript Libraries
import sys
import clr
clr.AddReference('ProtoGeometry')
from Autodesk.DesignScript.Geometry import *

clr.AddReference('RevitAPI')
from Autodesk.Revit.DB import *
import Autodesk

clr.AddReference('RevitServices')
import RevitServices
from RevitServices.Persistence import DocumentManager
from RevitServices.Transactions import TransactionManager as t
doc = DocumentManager.Instance.CurrentDBDocument

#################################Module For Functional Programing#############################################
from functools import reduce
curry = lambda f: lambda a,*args: f(a, *args) if (len(args)) else lambda *args: f(a, *args)

filter = curry(filter)
map = curry(map)

def _take(length, iter):
    res = []
    for a in iter:
        res.append(a)
        if len(res) == length:
            return res
        
take = curry(_take)
reduce = curry(reduce)

go = lambda *args: reduce(lambda a,f: f(a), args) ## 함수도 축약 가능 ##
##############################################################################################################
# The inputs to this node will be stored as a list in the IN variables.
dataEnteringNode = IN

# Place your code below this line
def get_famTypeByCat(cat):
    bics = {
        "Wall": lambda x: x.OfCategory(BuiltInCategory.OST_Walls),
        "Roof": lambda x: x.OfCategory(BuiltInCategory.OST_Roofs),
        "Door": lambda x: x.OfCategory(BuiltInCategory.OST_Doors),
        "Window": lambda x: x.OfCategory(BuiltInCategory.OST_Windows),
        "StrFrame": lambda x: x.OfCategory(BuiltInCategory.OST_StructuralFraming),
    }
    collector = FilteredElementCollector(doc)
    all_Types = go\
    (
        collector,
        bics[cat],
        lambda x: x.WhereElementIsElementType(),
        lambda x: x.ToElements(),
        list
    )
    
    return all_Types
# Assign your output to the OUT variable.
OUT = get_famTypeByCat("StrFrame")
# ----------------------------------------
parameters = Element.Parameters(element=python_script)
code_block = CodeBlock { "Type Name"; }
getParameterValueByName = Element.GetParameterValueByName(element=python_script, parameterName=code_block)
code_block_2 = CodeBlock { "ASB_"; }
contains = String.Contains(string=getParameterValueByName, searchFor=code_block_2)
filterByBoolMask = List.FilterByBoolMask(list=python_script, mask=contains)
code_block_3 = CodeBlock(i=filterByBoolMask.in) { i; }
code_block_4 = CodeBlock { "Type Name"; }
filterByBoolMask_2 = List.FilterByBoolMask(list=getParameterValueByName, mask=contains)
code_block_5 = CodeBlock { "ASB_"; "AR_S02_"; }
replace = String.Replace(string=filterByBoolMask_2.in, searchFor=code_block_5.out0, replaceWith=code_block_5.out1)
setParameterByName = Element.SetParameterByName(element=code_block_3, parameterName=code_block_4, value=replace)
