# Dynamo graph 4-1.dyn (Dynamo 2.12.0.5650)

parameters = Element.Parameters()  # frozen; unwired: element
code_block = CodeBlock(i=parameters)
# ---------- code_block.designscript (9 lines) ----------
[
i[2],
i[4],
i[83],
i[85],
i[10],
i[50],
i[9]
];
# ----------------------------------------
select_model_element = DSModelElementSelection()  # 1 picked in the model
code_block_2 = CodeBlock()
# ---------- code_block_2.designscript (4 lines) ----------
[
"Column Location Mark",
"Top Offset"
];
# ----------------------------------------
getParameterValueByName = Element.GetParameterValueByName(element=select_model_element, parameterName=code_block_2)
