# Dynamo graph 4-2.dyn (Dynamo 2.12.0.5650)

parameters = Element.Parameters()  # frozen; unwired: element
code_block = CodeBlock(i=parameters)
# ---------- code_block.designscript (9 lines) ----------
[
i[2],
i[4],
i[83],
i[85],
i[10],
i[50],
i[9]
];
# ----------------------------------------
select_model_element = DSModelElementSelection()  # 1 picked in the model
code_block_2 = CodeBlock()
# ---------- code_block_2.designscript (4 lines) ----------
[
"Column Location Mark",
"Top Offset"
];
# ----------------------------------------
getParameterValueByName = Element.GetParameterValueByName(element=select_model_element, parameterName=code_block_2)
code_block_3 = CodeBlock { "Top Offset"; }
code_block_4 = CodeBlock { 1000; }
setParameterByName = Element.SetParameterByName(element=select_model_element, parameterName=code_block_3, value=code_block_4)
code_block_5 = CodeBlock { "Base Offset"; }
code_block_6 = CodeBlock { 1000; }
setParameterByName_2 = Element.SetParameterByName(element=setParameterByName, parameterName=code_block_5, value=code_block_6)
