# Dynamo graph 4-3.dyn (Dynamo 2.12.0.5650)

# group: 그리드 소환 및 분류
categories = Categories("OST_Grids")
all_elements_of_category = ElementsOfCategory(Category=categories)
curve = Grid.Curve()  # unwired: grid
direction = Line.Direction()  # unwired: line
function_compose = ComposeFunctions(function0=curve, function1=direction)
groupByFunction = List.GroupByFunction(list=all_elements_of_category, groupFunction=function_compose)

# group: X축방향 그리드 - Line, 이름 추출
# note: X direction Grid
lastItem = List.LastItem(list=groupByFunction)
name = Element.Name(element=lastItem)
curve_2 = Grid.Curve(grid=lastItem)

# group: Y축방향 그리드 - Line, 이름 추출
# note: Y direction Grid
firstItem = List.FirstItem(list=groupByFunction)
name_2 = Element.Name(element=firstItem)
curve_3 = Grid.Curve(grid=firstItem)

# group: Location Mark 형성
code_block = CodeBlock { "-"; }
join = String.Join(separator=code_block, lacing=CrossProduct)  # unwired: string0, string1
cartesianProduct = List.CartesianProduct(combineFunction=join, list0=name, list1=name_2)
flatten = List.Flatten(list=cartesianProduct)

# group: 교점추출
intersect = Geometry.Intersect(geometry=curve_2, other=curve_3, lacing=CrossProduct)
flatten_2 = List.Flatten(list=intersect)

byKeysValues = DesignScript.Builtin.Dictionary.ByKeysValues(keys=flatten, values=flatten_2)

# group: Data Import
file_path = Filename("documentum\table.txt")  # graph input
boolean = BoolSelector(true)
importCSV = Data.ImportCSV(filePath=file_path, transpose=boolean)
code_block_2 = CodeBlock { "	"; }
split = String.Split(string=importCSV, separator0=code_block_2)

# group: Arrange Data
code_block_3 = CodeBlock { 2; }
dropItems = List.DropItems(list=split@L2, amount=code_block_3)
deconstruct = List.Deconstruct(list=dropItems)

# group: Location Mark 추출 관련
code_block_4 = CodeBlock { 0; }
getItemAtIndex = List.GetItemAtIndex(list=deconstruct.rest@L2, index=code_block_4)

# group: 부재별 좌표
valueAtKey = DesignScript.Builtin.Dictionary.ValueAtKey(dictionary=byKeysValues, key=getItemAtIndex)

# group: Column 커브 추출 관련
code_block_5 = CodeBlock { 2; }
getItemAtIndex_2 = List.GetItemAtIndex(list=deconstruct.rest@L2, index=code_block_5)
code_block_6 = CodeBlock { 1; }
getItemAtIndex_3 = List.GetItemAtIndex(list=deconstruct.rest@L2, index=code_block_6)

# group: Finish Level 정리
categories_2 = Categories("OST_Levels")
all_elements_of_category_2 = ElementsOfCategory(Category=categories_2)
name_3 = Level.Name(level=all_elements_of_category_2)
eq = name_3 == getItemAtIndex_2  # lacing=CrossProduct
transpose = List.Transpose(lists=eq)
boolean_2 = BoolSelector(true)
allIndicesOf = List.AllIndicesOf(list=transpose@L2, item=boolean_2)
getItemAtIndex_4 = List.GetItemAtIndex(list=all_elements_of_category_2, index=allIndicesOf)

flatten_3 = List.Flatten(list=getItemAtIndex_4)
elevation = Level.Elevation(level=flatten_3)

# group: Start Level 정리
categories_3 = Categories("OST_Levels")
all_elements_of_category_3 = ElementsOfCategory(Category=categories_3)
name_4 = Level.Name(level=all_elements_of_category_3)
eq_2 = name_4 == getItemAtIndex_3  # lacing=CrossProduct
transpose_2 = List.Transpose(lists=eq_2)
boolean_3 = BoolSelector(true)
allIndicesOf_2 = List.AllIndicesOf(list=transpose_2@L2, item=boolean_3)
getItemAtIndex_5 = List.GetItemAtIndex(list=all_elements_of_category_3, index=allIndicesOf_2)

flatten_4 = List.Flatten(list=getItemAtIndex_5)
elevation_2 = Level.Elevation(level=flatten_4)

# group: 부재별 길이
sub = elevation - elevation_2

# group: 부재별 커브
ZAxis = Vector.ZAxis()
byStartPointDirectionLength = Line.ByStartPointDirectionLength(startPoint=valueAtKey, direction=ZAxis, length=sub)
fl_gap = DoubleInput(300)  # graph input
translate = Geometry.Translate(geometry=byStartPointDirectionLength, direction=ZAxis, distance=fl_gap)

# group: 부재별 배치레벨
부재별_배치레벨 = CodeBlock(i=flatten_4) { i; }

# group: Family Type 추출 관련
code_block_7 = CodeBlock { 3; }
getItemAtIndex_6 = List.GetItemAtIndex(list=deconstruct.rest@L2, index=code_block_7)

# group: 부재별 패밀리타입
byName = FamilyType.ByName(name=getItemAtIndex_6)

# group: 부재별 패밀리타입
부재별_패밀리타입 = CodeBlock(i=byName) { i; }

columnByCurve = StructuralFraming.ColumnByCurve(curve=translate, level=부재별_배치레벨, structuralColumnType=부재별_패밀리타입)
code_block_8 = CodeBlock { "Base Offset"; 0; }
setParameterByName = Element.SetParameterByName(element=columnByCurve, parameterName=code_block_8.out0, value=code_block_8.out1)
