# Dynamo graph 교육5 실습.dyn (Dynamo 2.12.0.5650)

# group: 4. 여러 항목 중 내가 원하는 것을 골라서 선택하기 (Filtering)

# group: <<Dynamo usage tutorial>>
# note: >>>>>>>>>>>>>>>>>>>>>>>>>>>>>>>>>>>>>>>>>>>>>>>>>>>>>>>>>>>>>>>>>>>>>>>>>>>>>>>>>>>>>>>>>>>>>>>>>>>>>>
# note: 준비가 되셨으면 오른쪽으로 화면을 이동해주세요
# note: 안녕하십니까. 5주차 교육 (다이나모 활용) 입니다.

# group: 2. 다이나모로 하고 싶은 일 구상하기 (pseudo-code)
code_block = CodeBlock()  # //모든 벽들 중에,
code_block_2 = CodeBlock()  # //측면의 형상만 뽑아낸 후
code_block_3 = CodeBlock()  # //콘크리트 벽 전체 거푸집 물량을 구하자
code_block_4 = CodeBlock()  # //재료로 콘크리트가 들어간 벽만 골라서;
code_block_5 = CodeBlock()  # //면적을 계산해서

# group: 1. 주된 활용의 원리
code_block_6 = CodeBlock { 대상요소선택; }  # unwired: 대상요소선택
code_block_7 = CodeBlock(속성선택=code_block_6) { 속성선택; }
code_block_8 = CodeBlock(조회_및_활용=code_block_7) { 조회_및_활용; }
code_block_9 = CodeBlock(속성조작=code_block_7) { 속성조작; }

# group: 3. 모델링 요소이던, 도면화 요소이던, "리스트"로 만들면 조작할 수 있다.
code_block_10 = CodeBlock()  # //뷰는 객체일까 아닐까
code_block_11 = CodeBlock()  # //다이나모로 태그를 조작할 수 있을까 없을까
code_block_12 = CodeBlock()  # //시트는 객체일까 아닐까

categories = Categories("OST_Views")
all_elements_of_category = ElementsOfCategory(Category=categories)
categories_2 = Categories("OST_Sheets")
all_elements_of_category_2 = ElementsOfCategory(Category=categories_2)
parameters = Element.Parameters(element=all_elements_of_category_2)
code_block_13 = CodeBlock { "Approved By"; }
code_block_14 = CodeBlock { "MK"; }
setParameterByName = Element.SetParameterByName(element=all_elements_of_category_2, parameterName=code_block_13, value=code_block_14)

# group: 모든 벽들 중에,
categories_3 = Categories("OST_Walls")
all_elements_of_category_3 = ElementsOfCategory(Category=categories_3)

# group: 1차 필터링: 재료로 콘크리트가 들어간 벽만 골라서
getMaterials = Element.GetMaterials(element=all_elements_of_category_3)
name = Material.Name(material=getMaterials)
code_block_15 = CodeBlock { "Structural Concrete"; }
contains = String.Contains(string=name, searchFor=code_block_15)
anyTrue = List.AnyTrue(list=contains@L2)
filterByBoolMask = List.FilterByBoolMask(list=all_elements_of_category_3, mask=anyTrue)

faces = Element.Faces(element=filterByBoolMask.in)

# group: 2차 필터링: 혹시라도 벽이 아닌 객체를 제외하고
code_block_16 = CodeBlock { "Family and Type"; }
getParameterValueByName = Element.GetParameterValueByName(element=filterByBoolMask.in, parameterName=code_block_16)
code_block_17 = CodeBlock { "Type Name"; }
getParameterValueByName_2 = Element.GetParameterValueByName(element=getParameterValueByName, parameterName=code_block_17)
code_block_18 = CodeBlock { "WA"; }
startsWith = String.StartsWith(string=getParameterValueByName_2, searchFor=code_block_18)
filterByBoolMask_2 = List.FilterByBoolMask(list=filterByBoolMask.in, mask=startsWith)

# group: 3차 필터링: 측면의 형상만 뽑아낸 후
faces_2 = Element.Faces(element=filterByBoolMask_2.in)
normalAtParameter = Surface.NormalAtParameter(surface=faces_2)
Z = Vector.Z(vector=normalAtParameter)
round = Math.Round(number=Z)
code_block_19 = CodeBlock { 0; }
eq = round == code_block_19
filterByBoolMask_3 = List.FilterByBoolMask(list=faces_2@L3, mask=eq)

# group: 면적을 계산해서
code_block_20 = CodeBlock(i=filterByBoolMask_3.in) { i[0]; }
area = Surface.Area(surface=code_block_20)
sum = Math.Sum(values=area)
code_block_21 = CodeBlock { 1000000; }
div = sum / code_block_21

# group: 콘크리트 벽 전체 거푸집 물량을 구하자
sum_2 = Math.Sum(values=div)
code_block_22 = CodeBlock { 3; }
round_2 = Math.Round(number=sum_2, digits=code_block_22)

code_block_23 = CodeBlock { 분류할_목록; }  # unwired: 분류할_목록
code_block_24 = CodeBlock { 분류할_규칙; }  # unwired: 분류할_규칙
filterByBoolMask_4 = List.FilterByBoolMask(list=code_block_23, mask=code_block_24)  # frozen
example = StringInput("""파일을 연다. 

파일의 각 행(line)에 대해서 단어를 찾는다. 

    그 단어를 지운다. 

    그 자리에 새로운 단어를 넣는다. 

파일을 닫는다.""")
# note: 의사코드 작성해보기
example_2 = StringInput("""파일을 연다.

사용자에게 바꾸고 싶은 단어가 무엇인지 물어 본다.

그리고 그 단어를 어떤 단어로 바꾸고 싶은지 물어 본다.

   파일의 각 행(line)에 대해서

       단어를 찾기 위해 다음과 같은 과정을 진행한다.

           각 글자를 읽어 들인다.

           글자가 바꾸고 싶은 단어의 첫 글자와 일치하면,

           끝까지 일치하는지 확인해 본 후

           일치한다면, 단어를 찾은 것이다.

       그 단어가 몇 번 나왔는지 센다.

       이제 그 단어에 해당하는 글자들을 지운다.

       그리고 그 자리에 새로운 단어에 해당하는 글자들을 채워 넣는다.

       단어를 몇 번 바꾸어 주었는지 사용자에게 알려준다.

파일을 닫는다.""")

# group: 벽체 시작과 끝의 좁은 surface 판별 힌트
getLocation = Element.GetLocation(element=filterByBoolMask_2.in)
direction = Line.Direction(line=getLocation)
normalized = Vector.Normalized(vector=direction)

n1차_필터링_재료로_콘크리트가_들어간_벽만_골라서 = Python(IN[0]=all_elements_of_category_3)  # "1차 필터링: 재료로 콘크리트가 들어간 벽만 골라서"; CPython3
# ---------- n1차_필터링_재료로_콘크리트가_들어간_벽만_골라서.python (40 lines) ----------
# Load the Python Standard and DesignScript Libraries
import sys
import clr
clr.AddReference('ProtoGeometry')
from Autodesk.DesignScript.Geometry import *

clr.AddReference("RevitNodes")
import Revit

from Revit.Elements import *

clr.AddReference("DSCoreNodes")
from DSCore import *

# The inputs to this node will be stored as a list in the IN variables.
dataEnteringNode = IN
elems = IN[0]

# Place your code below this line
def getMaterial(elem):
    return elem.GetMaterials()

def getMaterialNames(elem):
    materials = elem.GetMaterials()
    res = map(lambda x: x.Name, materials)
    return res

def isElemHasTarget(elem, target):
    materials = getMaterialNames(elem)
    blns = map(lambda x: target in x, materials)
    return any(blns)

def filter_ConcWall(elems):
    materialss = map(getMaterialNames, elems)
    
    res = filter(lambda materials: isElemHasTarget(materials, "Structural Concrete"), elems)
    return res

# Assign your output to the OUT variable.
OUT = filter_ConcWall(elems)
# ----------------------------------------
n2차_필터링_혹시라도_벽이_아닌_객체를_제외하고 = Python(IN[0]=n1차_필터링_재료로_콘크리트가_들어간_벽만_골라서)  # "2차 필터링: 혹시라도 벽이 아닌 객체를 제외하고"; CPython3
# ---------- n2차_필터링_혹시라도_벽이_아닌_객체를_제외하고.python (31 lines) ----------
# Load the Python Standard and DesignScript Libraries
import sys
import clr
clr.AddReference('ProtoGeometry')
from Autodesk.DesignScript.Geometry import *

clr.AddReference("RevitNodes")
import Revit

from Revit.Elements import *

clr.AddReference("DSCoreNodes")
from DSCore import *

# The inputs to this node will be stored as a list in the IN variables.
dataEnteringNode = IN
elems = IN[0]

# Place your code below this line

def determineOfInclusion(elem):
    if type(elem) is Revit.Elements.Wall:
        return elem
    else:
        pass
    
def cleanNone(iter):
    return filter(lambda x: x is not None,iter)

# Assign your output to the OUT variable.
OUT = cleanNone(map(determineOfInclusion, elems))
# ----------------------------------------
n3차_필터링_측면의_형상만_뽑아낸_후 = Python(IN[0]=n2차_필터링_혹시라도_벽이_아닌_객체를_제외하고)  # "3차 필터링: 측면의 형상만 뽑아낸 후"; CPython3
# ---------- n3차_필터링_측면의_형상만_뽑아낸_후.python (44 lines) ----------
# Load the Python Standard and DesignScript Libraries
import sys
import clr
clr.AddReference('ProtoGeometry')
from Autodesk.DesignScript.Geometry import *

clr.AddReference("RevitNodes")
import Revit

from Revit.Elements import *

clr.AddReference("DSCoreNodes")
from DSCore import *

# The inputs to this node will be stored as a list in the IN variables.
dataEnteringNode = IN
elems = IN[0]

# Place your code below this line

def findGeos(_elem):
    return _elem.Geometry()[0]
    
def findFaces(_elem):
    return _elem.Faces

def findSideSrf(_faces):
    normalVectors = map(lambda x: x.NormalAtParameter(0,0), _faces)
    normalZs = map(lambda x: float(str(x).split("= ")[2].split(", ")[0]), normalVectors)
    
    res = []
    for i,x in enumerate(_faces):
        if list(normalZs)[i] == 0:
            res.append(x)
        else:
            pass
    
    return res



faces = findFaces(elems[0])
# Assign your output to the OUT variable.
OUT = findSideSrf(faces)
# ----------------------------------------
