# Dynamo graph 교육5 실습_최종_교육생용.dyn (Dynamo 2.12.0.5650)

# group: 4. 여러 항목 중 내가 원하는 것을 골라서 선택하기 (Filtering)

# group: <<Dynamo usage tutorial>>
# note: >>>>>>>>>>>>>>>>>>>>>>>>>>>>>>>>>>>>>>>>>>>>>>>>>>>>>>>>>>>>>>>>>>>>>>>>>>>>>>>>>>>>>>>>>>>>>>>>>>>>>>
# note: 준비가 되셨으면 오른쪽으로 화면을 이동해주세요
# note: 안녕하십니까. 5주차 교육 (다이나모 활용) 입니다.

# group: 2. 다이나모로 하고 싶은 일 구상하기 (pseudo-code)
code_block = CodeBlock()  # //모든 벽들 중에,
code_block_2 = CodeBlock()  # //측면의 형상만 뽑아낸 후
code_block_3 = CodeBlock()  # //콘크리트 벽 전체 거푸집 물량을 구하자
code_block_4 = CodeBlock()  # //재료로 콘크리트가 들어간 벽만 골라서;
code_block_5 = CodeBlock()  # //면적을 계산해서

# group: 1. 주된 활용의 원리
code_block_6 = CodeBlock { 대상요소선택; }  # unwired: 대상요소선택
code_block_7 = CodeBlock(속성선택=code_block_6) { 속성선택; }
code_block_8 = CodeBlock(조회_및_활용=code_block_7) { 조회_및_활용; }
code_block_9 = CodeBlock(속성조작=code_block_7) { 속성조작; }

# group: 3. 모델링 요소이던, 도면화 요소이던, "리스트"로 만들면 조작할 수 있다.
code_block_10 = CodeBlock()  # //뷰는 객체일까 아닐까
code_block_11 = CodeBlock()  # //다이나모로 태그를 조작할 수 있을까 없을까
code_block_12 = CodeBlock()  # //시트는 객체일까 아닐까

categories = Categories("OST_Views")
all_elements_of_category = ElementsOfCategory(Category=categories)
categories_2 = Categories("OST_Sheets")
all_elements_of_category_2 = ElementsOfCategory(Category=categories_2)
code_block_13 = CodeBlock { 분류할_목록; }  # unwired: 분류할_목록
# note: 참, 거짓을 반환해주는 규칙이면 어떤 규칙이든 가능하다
code_block_14 = CodeBlock(분류할_규칙=code_block_13) { 분류할_규칙; }
filterByBoolMask = List.FilterByBoolMask(list=code_block_13, mask=code_block_14)  # frozen
example = StringInput("""파일을 연다. 

파일의 각 행(line)에 대해서 단어를 찾는다. 

    그 단어를 지운다. 

    그 자리에 새로운 단어를 넣는다. 

파일을 닫는다.""")
# note: 의사코드 작성해보기
example_2 = StringInput("""파일을 연다.

사용자에게 바꾸고 싶은 단어가 무엇인지 물어 본다.

그리고 그 단어를 어떤 단어로 바꾸고 싶은지 물어 본다.

   파일의 각 행(line)에 대해서

       단어를 찾기 위해 다음과 같은 과정을 진행한다.

           각 글자를 읽어 들인다.

           글자가 바꾸고 싶은 단어의 첫 글자와 일치하면,

           끝까지 일치하는지 확인해 본 후

           일치한다면, 단어를 찾은 것이다.

       그 단어가 몇 번 나왔는지 센다.

       이제 그 단어에 해당하는 글자들을 지운다.

       그리고 그 자리에 새로운 단어에 해당하는 글자들을 채워 넣는다.

       단어를 몇 번 바꾸어 주었는지 사용자에게 알려준다.

파일을 닫는다.""")

# group: 최종 실습
code_block_15 = CodeBlock()  # //!!!
code_block_16 = CodeBlock {  }

code_block_17 = CodeBlock { 0..9; }
filterByBoolMask_2 = List.FilterByBoolMask(list=code_block_17)  # unwired: mask
