# Dynamo graph 0624 Mass boundary auto modeling test 001.dyn (Dynamo 2.6.1.8786)
# packages: Clockwork for Dynamo 2.x 2.3.0

categories = Categories("OST_GenericModel")
all_elements_of_category = ElementsOfCategory(Category=categories)
levels = Levels("2nd")
name = Level.Name(level=levels)
watch = Watch(name)
code_block = CodeBlock { "Level"; }
getParameterValueByName = Element.GetParameterValueByName(element=all_elements_of_category, parameterName=code_block)
name_2 = Level.Name(level=getParameterValueByName)
watch_2 = Watch(name_2)
eq = watch == watch_2
watch_3 = Watch(eq)
filterByBoolMask = List.FilterByBoolMask(list=all_elements_of_category, mask=watch_3)
watch_4 = Watch(filterByBoolMask.in)
getLocation = Element.GetLocation(element=watch_4)
byBestFitThroughPoints = Plane.ByBestFitThroughPoints(points=getLocation@L1)
sort = List.Sort()  # unwired: list
byStartPointEndPoint = Line.ByStartPointEndPoint(endPoint=sort, lacing=CrossProduct)  # unwired: startPoint
flatten = List.Flatten(list=byStartPointEndPoint)
firstItem = List.FirstItem(list=getLocation)
byOriginNormal = Plane.ByOriginNormal(origin=firstItem)
geometry = Element.Geometry(element=watch_4)
intersect = Geometry.Intersect(geometry=byOriginNormal, other=geometry)
flatten_2 = List.Flatten(list=intersect)
clean = List.Clean(list=flatten_2)
perimeterCurves = Surface.PerimeterCurves(surface=clean)
clean_2 = List.Clean(list=perimeterCurves)
watch_5 = Watch(clean_2)
flatten_3 = List.Flatten(list=watch_5)
type = Object.Type(obj=getLocation)
firstItem_2 = List.FirstItem(list=type)
removeIfNot = List.RemoveIfNot(list=getLocation, type=firstItem_2)
python_script = Python(IN[0]=removeIfNot)
# ---------- python_script.python (55 lines) ----------
import clr
clr.AddReference('ProtoGeometry')
from Autodesk.DesignScript.Geometry import *

def ToVals(pt):
	return [pt.X,pt.Y,pt.Z]

def ToPts(ptVals):
	return Point.ByCoordinates(ptVals[0],ptVals[1],ptVals[2])

def CreateOutline(pts):
	crvs = []
	i = 0
	while i < len(pts):
		if i == len(pts)-1:
			crvs.append(Line.ByStartPointEndPoint(pts[i],pts[0]))
		else:
			crvs.append(Line.ByStartPointEndPoint(pts[i],pts[i+1]))
		i = i+1
	return PolyCurve.ByJoinedCurves(crvs)

'''
Taken from Thomas Switzers awesome GitHub repo and modified to suit Dynamo Context
https://gist.github.com/arthur-e/5cf52962341310f438e96c1f3c3398b8
I take zero credit for this work other than porting it across.
'''
def convex_hull_graham(points):
	'''
	Returns points on convex hull in CCW order according to Graham's scan algorithm. 
	By Tom Switzer <thomas.switzer@gmail.com>.
	'''
	TURN_LEFT, TURN_RIGHT, TURN_NONE = (1, -1, 0)

	def cmp(a, b):
		return (a > b) - (a < b)
	
	def turn(p, q, r):
		return cmp((q[0] - p[0])*(r[1] - p[1]) - (r[0] - p[0])*(q[1] - p[1]), 0)
	
	def _keep_left(hull, r):
		while len(hull) > 1 and turn(hull[-2], hull[-1], r) != TURN_LEFT:
			hull.pop()
		if not len(hull) or hull[-1] != r:
			hull.append(r)
		return hull

	points = [ToVals(p) for p in points]	
	points = sorted(points)
	l = reduce(_keep_left, points, [])
	u = reduce(_keep_left, reversed(points), [])
	points = l.extend(u[i] for i in range(1, len(u) - 1)) or l
	points = [ToPts(p) for p in points]
	return CreateOutline(points)

OUT = convex_hull_graham(IN[0])
# ----------------------------------------
doesIntersect = Geometry.DoesIntersect(geometry=python_script, other=flatten_3)
filterByBoolMask_2 = List.FilterByBoolMask(list=flatten_3, mask=doesIntersect)
ZAxis = Vector.ZAxis()
code_block_2 = CodeBlock { 1000; }
extrude = Curve.Extrude(curve=filterByBoolMask_2.in, direction=ZAxis, distance=code_block_2)
code_block_3 = CodeBlock { 300; }
thicken = Surface.Thicken(surface=extrude, thickness=code_block_3)
code_block_4 = CodeBlock { 200; }
byARGB = Color.ByARGB(a=code_block_4, r=code_block_4)
byGeometryColor = Modifiers.GeometryColor.ByGeometryColor(geometry=thicken, color=byARGB)
ZAxis_2 = Vector.ZAxis()
code_block_5 = CodeBlock { 1000; }
extrude_2 = Curve.Extrude(curve=filterByBoolMask_2.out, direction=ZAxis_2, distance=code_block_5)
code_block_6 = CodeBlock { 500; }
thicken_2 = Surface.Thicken(surface=extrude_2, thickness=code_block_6)
byARGB_2 = Color.ByARGB(a=code_block_4, g=code_block_4)
byGeometryColor_2 = Modifiers.GeometryColor.ByGeometryColor(geometry=thicken_2, color=byARGB_2)
byPatch = Surface.ByPatch(closedCurve=python_script)
doesIntersect_2 = Geometry.DoesIntersect(geometry=byPatch, other=flatten_3)
filterByBoolMask_3 = List.FilterByBoolMask(list=flatten_3, mask=doesIntersect_2)
ZAxis_3 = Vector.ZAxis()
code_block_7 = CodeBlock { 1000; }
extrude_3 = Curve.Extrude(curve=filterByBoolMask_3.out, direction=ZAxis_3, distance=code_block_7)
code_block_8 = CodeBlock { 500; }
thicken_3 = Surface.Thicken(surface=extrude_3, thickness=code_block_8)
code_block_9 = CodeBlock { 200; }
byARGB_3 = Color.ByARGB(a=code_block_9, g=code_block_9)
byGeometryColor_3 = Modifiers.GeometryColor.ByGeometryColor(geometry=thicken_3, color=byARGB_3)
ZAxis_4 = Vector.ZAxis()
code_block_10 = CodeBlock { 1000; }
extrude_4 = Curve.Extrude(curve=filterByBoolMask_3.in, direction=ZAxis_4, distance=code_block_10)
code_block_11 = CodeBlock { 300; }
thicken_4 = Surface.Thicken(surface=extrude_4, thickness=code_block_11)
byARGB_4 = Color.ByARGB(a=code_block_9, r=code_block_9)
byGeometryColor_4 = Modifiers.GeometryColor.ByGeometryColor(geometry=thicken_4, color=byARGB_4)

# group: Surface - 내/외부 Line 추출
code_block_12 = CodeBlock {  }
code_block_13 = CodeBlock {  }

# group: Polycurve - 내/외부 Line 추출
code_block_14 = CodeBlock {  }
code_block_15 = CodeBlock {  }

startPoint = Curve.StartPoint(curve=watch_5)
flatten_4 = List.Flatten(list=startPoint)
python_script_2 = Python(IN[0]=flatten_4)  # same code as python_script

# group: 외부 인식
byPatch_2 = Surface.ByPatch(closedCurve=python_script_2)
watch_6 = Watch(clean)
byJoinedSurfaces = PolySurface.ByJoinedSurfaces(surfaces=watch_6)
difference = Surface.Difference(surface=byPatch_2, others=byJoinedSurfaces)
doesIntersect_3 = Geometry.DoesIntersect(geometry=flatten_3, other=difference)
filterByBoolMask_4 = List.FilterByBoolMask(list=flatten_3, mask=doesIntersect_3)

flatten_5 = List.Flatten(list=filterByBoolMask_4.in)
flatten_6 = List.Flatten(list=filterByBoolMask_4.out)
pullOntoPlane = Curve.PullOntoPlane()  # unwired: curve, plane
code_block_16 = CodeBlock { "Point"; }
watch_7 = Watch(python_script_2)
explode = Geometry.Explode(geometry=watch_7)
join = List.Join(list0=filterByBoolMask_3.in, list1=filterByBoolMask_3.out, list2=explode)
watch_8 = Watch(byOriginNormal)
byPlane = SketchPlane.ByPlane(plane=watch_8)
views = Views("2nd")
watch_9 = Watch(views)
fromCurve = Custom[RoomSeparator.FromCurve](curve=join, sketchPlane=byPlane, view=watch_9)  # frozen; package Clockwork for Dynamo 2.x; Creates room separation lines from geometry curves.
watch_10 = Watch(filterByBoolMask.out)
elevation = Level.Elevation(level=levels)
geometry_2 = Element.Geometry(element=watch_4)
flatten_7 = List.Flatten(list=geometry_2)
categories_2 = Categories("OST_Rooms")
all_elements_of_category_2 = ElementsOfCategory(Category=categories_2)
coreBoundary = Room.CoreBoundary(room=all_elements_of_category_2)
code_block_17 = CodeBlock { 1; }
flatten_8 = List.Flatten(list=coreBoundary, amt=code_block_17)
startPoint_2 = Curve.StartPoint(curve=flatten_8)
boolean = BoolSelector(true)
byPoints = PolyCurve.ByPoints(points=startPoint_2, connectLastToFirst=boolean)
byPatch_3 = Surface.ByPatch(closedCurve=byPoints)
code_block_18 = CodeBlock { 0.5; }
pointAtParameter = Surface.PointAtParameter(surface=byPatch_3, u=code_block_18, v=code_block_18)
doesIntersect_4 = Geometry.DoesIntersect(geometry=pointAtParameter, other=flatten_7, lacing=CrossProduct)
filterByBoolMask_5 = List.FilterByBoolMask(list=flatten_7, mask=doesIntersect_4@L2)
watch_11 = Watch(filterByBoolMask_5.in)
flatten_9 = List.Flatten(list=watch_11)
code_block_19 = CodeBlock { 100; }
byARGB_5 = Color.ByARGB(a=code_block_19, r=code_block_19)
byGeometryColor_5 = Modifiers.GeometryColor.ByGeometryColor(color=byARGB_5)  # unwired: geometry
watch_12 = Watch(watch_4)
filterByBoolMask_6 = List.FilterByBoolMask(list=watch_12, mask=doesIntersect_4@L2)
watch_13 = Watch(filterByBoolMask_6.in)
code_block_20 = CodeBlock { "Room Name"; }
getParameterValueByName_2 = Element.GetParameterValueByName(element=watch_13, parameterName=code_block_20)
code_block_21 = CodeBlock { "Area"; }
getParameterValueByName_3 = Element.GetParameterValueByName(element=watch_13, parameterName=code_block_21)
count = List.Count(list=watch_13@L2)
watch_14 = Watch(count)
code_block_22 = CodeBlock(a=watch_14) { a>1; }
watch_15 = Watch(code_block_22)
filterByBoolMask_7 = List.FilterByBoolMask(list=watch_13, mask=watch_15@L2)
watch_16 = Watch(filterByBoolMask_7.in)
watch_17 = Watch(filterByBoolMask_7.out)
geometry_3 = Element.Geometry(element=all_elements_of_category_2)
flatten_10 = List.Flatten(list=geometry_3)
centroid = Solid.Centroid(solid=flatten_7)
doesIntersect_5 = Geometry.DoesIntersect(geometry=flatten_10, other=centroid, lacing=CrossProduct)
filterByBoolMask_8 = List.FilterByBoolMask(list=all_elements_of_category_2, mask=doesIntersect_5@L2)
watch_18 = Watch(filterByBoolMask_8.in)

# group: 검토 진행중... Room List와 Mass 리스트를 이치 시켜야 함
code_block_23 = CodeBlock {  }
code_block_24 = CodeBlock {  }
