# Dynamo graph 0826 space planning test_mk.dyn (Dynamo 2.10.1.3976)
# packages: GenerativeDesign.Revit 1.7.3.0, GenerativeDesign 1.7.3.0

# group: User Inputs for GDIR
# note: Custom Package: GenerativeDesign v.2021.5.5
select_room_to_load_program_into = DSModelRoomSelection()  # 1 picked in the model; graph input
# note: Retrieve the room's finish boundary.
# Note: The first sublist is the outermost boundary of the room.
finishBoundary = Room.FinishBoundary(room=select_room_to_load_program_into)
remember = Data.Remember(finishBoundary)

# group: Extract room boundary for DynaSpace and cache it in the graph
firstItem = List.FirstItem(list=remember@L3)
startPoint = Curve.StartPoint(curve=firstItem)
flatten = List.Flatten(list=startPoint)
byJoinedCurves = PolyCurve.ByJoinedCurves(curves=firstItem)
code_block = CodeBlock(BldgBoundary=byJoinedCurves)
# ---------- code_block.designscript (3 lines) ----------
{
"BldgBoundary": _BldgBoundary
};
# ----------------------------------------

# group: REC (사각형) 변경 전
code_block_2 = CodeBlock { _InputDic; }  # frozen; unwired: InputDic
code_block_3 = CodeBlock { "AreaPerDepartment"; }
valueAtKey = DesignScript.Builtin.Dictionary.ValueAtKey(dictionary=code_block_2, key=code_block_3)
code_block_4 = CodeBlock { "RoomCenterPointPerDepartment"; }
valueAtKey_2 = DesignScript.Builtin.Dictionary.ValueAtKey(dictionary=code_block_2, key=code_block_4)

code_block_5 = CodeBlock { "Length"; "Width"; }
valueAtKey_3 = DesignScript.Builtin.Dictionary.ValueAtKey(dictionary=code_block_2, key=code_block_5.out0)
code_block_6 = CodeBlock { "SpaceIDPerDepartment"; }
valueAtKey_4 = DesignScript.Builtin.Dictionary.ValueAtKey(dictionary=code_block_2, key=code_block_6)
flatten_2 = List.Flatten(list=valueAtKey_4)
getItemAtIndex = List.GetItemAtIndex(list=valueAtKey_3, index=flatten_2)
valueAtKey_5 = DesignScript.Builtin.Dictionary.ValueAtKey(dictionary=code_block_2, key=code_block_5.out1)
getItemAtIndex_2 = List.GetItemAtIndex(list=valueAtKey_5, index=flatten_2)

# group (continued): REC (사각형) 변경 전
byWidthLength = Rectangle.ByWidthLength(width=getItemAtIndex, length=getItemAtIndex_2)

flatten_3 = List.Flatten(list=valueAtKey_2)

# group (continued): REC (사각형) 변경 전
X = Point.X(point=flatten_3)

flatten_4 = List.Flatten(list=valueAtKey_2)

# group (continued): REC (사각형) 변경 전
Y = Point.Y(point=flatten_4)

flatten_5 = List.Flatten(list=valueAtKey_2)

# group (continued): REC (사각형) 변경 전
Z = Point.Z(point=flatten_5)
translate = Geometry.Translate(geometry=byWidthLength, xTranslation=X, yTranslation=Y, zTranslation=Z)
byPatch = Surface.ByPatch(closedCurve=translate)
code_block_7 = CodeBlock(RoomRectangle=translate, RoomRectangleZvalue=Z, RoomRectangleSurface=byPatch)
# ---------- code_block_7.designscript (5 lines) ----------
{
"RoomRectangle": _RoomRectangle,
"RoomRectangleZvalue": _RoomRectangleZvalue,
"RoomRectangleSurface": _RoomRectangleSurface
};
# ----------------------------------------
extendsChildDictionaryFromParent = Custom[ExtendsChildDictionaryFromParent](ParentDic=code_block_2, ChildDic=code_block_7)  # Extends Child Dictionary From Parent

# group: 부서별 색상 지정
code_block_8 = CodeBlock(InputDic=extendsChildDictionaryFromParent.dictionary) { _InputDic; }
code_block_9 = CodeBlock { "Department"; }
valueAtKey_6 = DesignScript.Builtin.Dictionary.ValueAtKey(dictionary=code_block_8, key=code_block_9)
watch = Watch(valueAtKey_6)
uniqueItems = List.UniqueItems(list=watch)
code_block_10 = CodeBlock()
# ---------- code_block_10.designscript (6 lines) ----------
color1 = Color.ByARGB(200, 100, 0, 200);
color2 = Color.ByARGB(200, 0, 0, 0);
color3 = Color.ByARGB(200, 200, 0, 0);
color4 = Color.ByARGB(200, 0, 0, 200);
color5 = Color.ByARGB(200, 200, 0, 100);
color6 = Color.ByARGB(200, 0, 200, 0);
# ----------------------------------------
remember_2 = Data.Remember(code_block_10.color1)
remember_3 = Data.Remember(code_block_10.color2)
remember_4 = Data.Remember(code_block_10.color3)
remember_5 = Data.Remember(code_block_10.color4)
remember_6 = Data.Remember(code_block_10.color5)
remember_7 = Data.Remember(code_block_10.color6)
join = List.Join(list0=remember_2, list1=remember_3, list2=remember_4, list3=remember_5, list4=remember_6, list5=remember_7)
byKeysValues = DesignScript.Builtin.Dictionary.ByKeysValues(keys=uniqueItems, values=join)
code_block_11 = CodeBlock(DepartmentColorDic=byKeysValues)
# ---------- code_block_11.designscript (3 lines) ----------
{
"DepartmentColorDic": _DepartmentColorDic
};
# ----------------------------------------
extendsChildDictionaryFromParent_2 = Custom[ExtendsChildDictionaryFromParent](ParentDic=code_block_8, ChildDic=code_block_11)

# group: 사각 공간 색상 지정
code_block_12 = CodeBlock(InputDic=extendsChildDictionaryFromParent_2.dictionary) { _InputDic; }
code_block_13 = CodeBlock { "RoomRectangleSurface"; }
valueAtKey_7 = DesignScript.Builtin.Dictionary.ValueAtKey(dictionary=code_block_12, key=code_block_13)
code_block_14 = CodeBlock { "BoxHeight"; }
valueAtKey_8 = DesignScript.Builtin.Dictionary.ValueAtKey(dictionary=code_block_12, key=code_block_14)
boolean = BoolSelector(false)
thicken = Surface.Thicken(surface=valueAtKey_7, thickness=valueAtKey_8, both_sides=boolean)
code_block_15 = CodeBlock { "DepartmentColorDic"; }
valueAtKey_9 = DesignScript.Builtin.Dictionary.ValueAtKey(dictionary=code_block_12, key=code_block_15)
code_block_16 = CodeBlock { "Department"; }
valueAtKey_10 = DesignScript.Builtin.Dictionary.ValueAtKey(dictionary=code_block_12, key=code_block_16)
code_block_17 = CodeBlock { "SpaceIDPerDepartment"; }
valueAtKey_11 = DesignScript.Builtin.Dictionary.ValueAtKey(dictionary=code_block_12, key=code_block_17)
flatten_6 = List.Flatten(list=valueAtKey_11)
getItemAtIndex_3 = List.GetItemAtIndex(list=valueAtKey_10, index=flatten_6)
valueAtKey_12 = DesignScript.Builtin.Dictionary.ValueAtKey(dictionary=valueAtKey_9, key=getItemAtIndex_3)
byGeometryColor = Modifiers.GeometryColor.ByGeometryColor(geometry=thicken, color=valueAtKey_12)
code_block_18 = CodeBlock(RoomSolid=thicken)
# ---------- code_block_18.designscript (3 lines) ----------
{
"RoomSolid": _RoomSolid
};
# ----------------------------------------
extendsChildDictionaryFromParent_3 = Custom[ExtendsChildDictionaryFromParent](ParentDic=code_block_12, ChildDic=code_block_18)

# group: GD Output - difference area to minimum
code_block_19 = CodeBlock(InputDic=extendsChildDictionaryFromParent_3.dictionary) { _InputDic; }
code_block_20 = CodeBlock { "RoomRectangle"; }
valueAtKey_13 = DesignScript.Builtin.Dictionary.ValueAtKey(dictionary=code_block_19, key=code_block_20)
flatten_7 = List.Flatten(list=valueAtKey_13)
code_block_21 = CodeBlock { "RoomRectangleZvalue"; }
valueAtKey_14 = DesignScript.Builtin.Dictionary.ValueAtKey(dictionary=code_block_19, key=code_block_21)
flatten_8 = List.Flatten(list=valueAtKey_14)
uniqueItems_2 = List.UniqueItems(list=flatten_8)
allIndicesOf = List.AllIndicesOf(list=flatten_8, item=uniqueItems_2)
code_block_22 = CodeBlock { "RoomBoundary"; }
valueAtKey_15 = DesignScript.Builtin.Dictionary.ValueAtKey(dictionary=code_block_19, key=code_block_22)
basePlane = PolyCurve.BasePlane(polyCurve=valueAtKey_15)
firstItem_2 = List.FirstItem(list=basePlane)
code_block_23 = CodeBlock { 1; }
code_block_24 = CodeBlock { 10; }
offset = Curve.Offset(curve=valueAtKey_15, distance=code_block_24)

flatten_9 = List.Flatten(list=allIndicesOf)

# group (continued): GD Output - difference area to minimum
getItemAtIndex_4 = List.GetItemAtIndex(list=flatten_7, index=flatten_9)
pullOntoPlane = Curve.PullOntoPlane(curve=getItemAtIndex_4, plane=firstItem_2)
byPatch_2 = Surface.ByPatch(closedCurve=pullOntoPlane)
split = Geometry.Split(geometry=byPatch_2, other=valueAtKey_15, lacing=CrossProduct)
flatten_10 = List.Flatten(list=split@L2, amt=code_block_23)
flatten_11 = List.Flatten(list=flatten_10)
doesIntersect = Geometry.DoesIntersect(geometry=flatten_11@L2, other=offset@L1)
flatten_12 = List.Flatten(list=doesIntersect)
filterByBoolMask = List.FilterByBoolMask(list=flatten_11, mask=flatten_12)
area = Surface.Area(surface=filterByBoolMask.in)
math_sum_outside_area_of = Math.Sum(values=area)  # "Math.Sum@Outside Area of Boundary"; graph output

# group: 고정부 Seed
seed_고정부_코어 = DoubleSlider(533, range=0..999 step 1)  # graph input

# group: 변동부 Seed
seed_변형부_공간 = DoubleSlider(277, range=0..999 step 1)  # graph input

# group: 회전 Seed
seed_회전용 = DoubleSlider(578, range=0..999 step 1)  # graph input

# group: Floor Level
code_block_25 = CodeBlock { [-6000, 0, 6000, 12000]; }

code_block_26 = CodeBlock(FixedPartSeed=seed_고정부_코어, NonFixedPartSeed=seed_변형부_공간, RotatingSeed=seed_회전용, FloorLevel=code_block_25)
# ---------- code_block_26.designscript (6 lines) ----------
{
"FixedPartSeed": _FixedPartSeed,
"NonFixedPartSeed": _NonFixedPartSeed,
"RotatingSeed": _RotatingSeed,
"FloorLevel": _FloorLevel
};
# ----------------------------------------
extendsChildDictionaryFromParent_4 = Custom[ExtendsChildDictionaryFromParent](ParentDic=code_block, ChildDic=code_block_26)

# group: Excel Data import (package 정리 전)
file_path = Filename("상상진화\20210824\space planning test 0802mk 001.xlsx")
file_from_path = FileObject(path=file_path)
string_from_object = FromObject(object=file_from_path)
code_block_27 = CodeBlock { "Sheet1"; "SampleBuildingProgram-Clinic"; false; }
python_script_import_excel_by = Python(IN[0]=string_from_object, IN[1]=code_block_27.out0)  # "Python Script@Import Excel(By OpenpyXl)"; CPython3
# ---------- python_script_import_excel_by.python (50 lines) ----------
# Load the Python Standard and DesignScript Libraries
import sys
import os
#sys.path.append(r'C:\Users\HEC\AppData\Local\Programs\Python\Python39\Lib\site-packages')
#sys.path.append(r'C:\Users\pjmk0\AppData\Local\Programs\Python\Python39\Lib\site-packages')
sys.path.append(os.getenv('LOCALAPPDATA').replace('\\','\\\\') + r'\Programs\Python\Python39\Lib\site-packages')
import clr
clr.AddReference('ProtoGeometry')
from Autodesk.DesignScript.Geometry import *
from collections import Iterable

def iterable(obj):
    return isinstance(obj, Iterable)


# The inputs to this node will be stored as a list in the IN variables.
dataEnteringNode = IN
PathIn = IN[0]
SheetNameIn = IN[1]

# Place your code below this line
import datetime
import openpyxl

path = (PathIn)
#path = (r'C:\Users\pjmk0\Downloads\MK\mQ\BIM_물량집계 자동화 산출기준표_rC(20210607)_mk_de.xlsx')

wb_obj = openpyxl.load_workbook(path, data_only=True)
sheet_obj = wb_obj.get_sheet_by_name(SheetNameIn)

m_row = sheet_obj.max_row
m_col = sheet_obj.max_column

listOut = []



for i in range(1, m_row +1):
    listTemp = []
    for j in range(1, m_col + 1):
        cell_obj = sheet_obj.cell(row=i, column=j)
        listTemp.append(cell_obj.value)
        if len(listTemp) == m_col:
            listOut.append(listTemp)
        


# Assign your output to the OUT variable.
OUT = listOut
#OUT = os.getenv('APPDATA')
# ----------------------------------------
excel_data_정리_전 = Watch(python_script_import_excel_by)

remember_8 = Data.Remember(excel_data_정리_전)

# group: Excel List 분할
excel_data_정리_전_2 = Watch(remember_8)
transpose = List.Transpose(lists=excel_data_정리_전_2)
code_block_28 = CodeBlock { 1; }
# note: List Name 정리
dropItems = List.DropItems(list=transpose@L2, amount=code_block_28)
watch_2 = Watch(dropItems)
code_block_29 = CodeBlock { 0; }
getItemAtIndex_5 = List.GetItemAtIndex(list=watch_2, index=code_block_29)
space_id = Watch(getItemAtIndex_5)
code_block_30 = CodeBlock { 1; }
getItemAtIndex_6 = List.GetItemAtIndex(list=watch_2, index=code_block_30)
space_name = Watch(getItemAtIndex_6)
code_block_31 = CodeBlock { 10; }
getItemAtIndex_7 = List.GetItemAtIndex(list=watch_2, index=code_block_31)
adjacent_spaces = Watch(getItemAtIndex_7)
code_block_32 = CodeBlock { 3; }
getItemAtIndex_8 = List.GetItemAtIndex(list=watch_2, index=code_block_32)
department_id = Watch(getItemAtIndex_8)
code_block_33 = CodeBlock { 2; }
getItemAtIndex_9 = List.GetItemAtIndex(list=watch_2, index=code_block_33)
DEPARTMENT = Watch(getItemAtIndex_9)
code_block_34 = CodeBlock { 11; }
getItemAtIndex_10 = List.GetItemAtIndex(list=watch_2, index=code_block_34)
lev = Watch(getItemAtIndex_10)
code_block_35 = CodeBlock { 5; }
getItemAtIndex_11 = List.GetItemAtIndex(list=watch_2, index=code_block_35)
WIDTH = Watch(getItemAtIndex_11)
code_block_36 = CodeBlock { 6; }
getItemAtIndex_12 = List.GetItemAtIndex(list=watch_2, index=code_block_36)
length = Watch(getItemAtIndex_12)
code_block_37 = CodeBlock { 7; }
getItemAtIndex_13 = List.GetItemAtIndex(list=watch_2, index=code_block_37)
height = Watch(getItemAtIndex_13)
code_block_38 = CodeBlock { 8; }
getItemAtIndex_14 = List.GetItemAtIndex(list=watch_2, index=code_block_38)
AREA = Watch(getItemAtIndex_14)
code_block_39 = CodeBlock { 14; }
getItemAtIndex_15 = List.GetItemAtIndex(list=watch_2, index=code_block_39)
ROTATE = Watch(getItemAtIndex_15)
code_block_40 = CodeBlock { 15; }
getItemAtIndex_16 = List.GetItemAtIndex(list=watch_2, index=code_block_40)
CLUSTER = Watch(getItemAtIndex_16)
code_block_41 = CodeBlock(ExcelDataWithNoHead=watch_2, SpaceID=space_id, SpaceName=space_name, AdjacentSpaces=adjacent_spaces, DepartmentID=department_id, Department=DEPARTMENT, Level=lev, Width=WIDTH, Length=length, Height=height, Area=AREA, Rotate=ROTATE, Cluster=CLUSTER)
# ---------- code_block_41.designscript (15 lines) ----------
{
"ExcelDataWithNoHead": _ExcelDataWithNoHead,
"SpaceID": _SpaceID,
"SpaceName": _SpaceName,
"AdjacentSpaces": _AdjacentSpaces,
"DepartmentID": _DepartmentID,
"Department": _Department,
"Level": _Level,
"Width": _Width,
"Length": _Length,
"Height": _Height,
"Area": _Area,
"Rotate": _Rotate,
"Cluster": _Cluster
};
# ----------------------------------------

code_block_42 = CodeBlock(InputDic=code_block_41) { _InputDic; }
code_block_43 = CodeBlock { "SpaceID"; }
valueAtKey_16 = DesignScript.Builtin.Dictionary.ValueAtKey(dictionary=code_block_42, key=code_block_43)
code_block_44 = CodeBlock { "SpaceName"; }
valueAtKey_17 = DesignScript.Builtin.Dictionary.ValueAtKey(dictionary=code_block_42, key=code_block_44)
code_block_45 = CodeBlock { "AdjacentSpaces"; }
valueAtKey_18 = DesignScript.Builtin.Dictionary.ValueAtKey(dictionary=code_block_42, key=code_block_45)
code_block_46 = CodeBlock { "DepartmentID"; }
valueAtKey_19 = DesignScript.Builtin.Dictionary.ValueAtKey(dictionary=code_block_42, key=code_block_46)
code_block_47 = CodeBlock { "Department"; }
valueAtKey_20 = DesignScript.Builtin.Dictionary.ValueAtKey(dictionary=code_block_42, key=code_block_47)
code_block_48 = CodeBlock { "Level"; }
valueAtKey_21 = DesignScript.Builtin.Dictionary.ValueAtKey(dictionary=code_block_42, key=code_block_48)
code_block_49 = CodeBlock { "Width"; }
valueAtKey_22 = DesignScript.Builtin.Dictionary.ValueAtKey(dictionary=code_block_42, key=code_block_49)
code_block_50 = CodeBlock { "Length"; }
valueAtKey_23 = DesignScript.Builtin.Dictionary.ValueAtKey(dictionary=code_block_42, key=code_block_50)
code_block_51 = CodeBlock { "Height"; }
valueAtKey_24 = DesignScript.Builtin.Dictionary.ValueAtKey(dictionary=code_block_42, key=code_block_51)
code_block_52 = CodeBlock { "Area"; }
valueAtKey_25 = DesignScript.Builtin.Dictionary.ValueAtKey(dictionary=code_block_42, key=code_block_52)
code_block_53 = CodeBlock { "Rotate"; }
valueAtKey_26 = DesignScript.Builtin.Dictionary.ValueAtKey(dictionary=code_block_42, key=code_block_53)
code_block_54 = CodeBlock { "Cluster"; }
valueAtKey_27 = DesignScript.Builtin.Dictionary.ValueAtKey(dictionary=code_block_42, key=code_block_54)
code_block_55 = CodeBlock(BoxSpaceID=valueAtKey_16, BoxSpaceName=valueAtKey_17, BoxAdjacentSpaces=valueAtKey_18, BoxDepartmentID=valueAtKey_19, BoxDepartment=valueAtKey_20, BoxLevel=valueAtKey_21, BoxWidth=valueAtKey_22, BoxLength=valueAtKey_23, BoxHeight=valueAtKey_24, BoxArea=valueAtKey_25, BoxRotate=valueAtKey_26, BoxCluster=valueAtKey_27)
# ---------- code_block_55.designscript (15 lines) ----------
///Box Class Primary
{
"BoxSpaceID": _BoxSpaceID,
"BoxSpaceName": _BoxSpaceName,
"BoxAdjacentSpaces": _BoxAdjacentSpaces,
"BoxDepartmentID": _BoxDepartmentID,
"BoxDepartment": _BoxDepartment,
"BoxLevel": _BoxLevel,
"BoxWidth": _BoxWidth,
"BoxLength": _BoxLength,
"BoxHeight": _BoxHeight,
"BoxArea": _BoxArea,
"BoxRotate": _BoxRotate,
"BoxCluster": _BoxCluster
};
# ----------------------------------------
code_block_56 = CodeBlock(BoxClass_Primary=code_block_55)
# ---------- code_block_56.designscript (3 lines) ----------
{
"BoxClass_Primary": _BoxClass_Primary
};
# ----------------------------------------
extendsChildDictionaryFromParent_5 = Custom[ExtendsChildDictionaryFromParent](ParentDic=extendsChildDictionaryFromParent_4.dictionary, ChildDic=code_block_56)
watch_3 = Watch(extendsChildDictionaryFromParent_5.key)
code_block_57 = CodeBlock(InputDic=extendsChildDictionaryFromParent_5.dictionary) { _InputDic; }
setBoxZvalueProp = Custom[SetBoxZvalueProp](InputDic=code_block_57)  # SetBoxZvalueProp

# group: 룸 BoundingBox 그리드 포인트 생성
code_block_58 = CodeBlock(InputDic=setBoxZvalueProp) { _InputDic; }
code_block_59 = CodeBlock { "BldgBoundary"; }
valueAtKey_28 = DesignScript.Builtin.Dictionary.ValueAtKey(dictionary=code_block_58, key=code_block_59)
byGeometry = BoundingBox.ByGeometry(geom=valueAtKey_28)
minPoint = BoundingBox.MinPoint(boundingBox=byGeometry)
X_2 = Point.X(point=minPoint)
maxPoint = BoundingBox.MaxPoint(boundingBox=byGeometry)
X_3 = Point.X(point=maxPoint)
code_block_60 = CodeBlock { 500; }
code_block_61 = CodeBlock(a=X_2, b=X_3, x=code_block_60) { a..b..x; }
Y_2 = Point.Y(point=minPoint)
Y_3 = Point.Y(point=maxPoint)
code_block_62 = CodeBlock { 500; }
code_block_63 = CodeBlock(a=Y_2, b=Y_3, x=code_block_62) { a..b..x; }
byCoordinates = Point.ByCoordinates(x=code_block_61, y=code_block_63, lacing=CrossProduct)
flatten_13 = List.Flatten(list=byCoordinates)
code_block_64 = CodeBlock(GridPointOfBldgBoundary=flatten_13)
# ---------- code_block_64.designscript (3 lines) ----------
{
"GridPointOfBldgBoundary": _GridPointOfBldgBoundary
};
# ----------------------------------------
extendsChildDictionaryFromParent_6 = Custom[ExtendsChildDictionaryFromParent](ParentDic=code_block_58, ChildDic=code_block_64)

distributeRandomSeedForFixedPart = Custom[DistributeRandomSeedForFixedPart](InputDic=extendsChildDictionaryFromParent_6.dictionary)  # DistributeRandomSeedForFixedPart

# group: Fixed Part 형상 배치 by Seed(회전 고려)
code_block_65 = CodeBlock(InputDic=distributeRandomSeedForFixedPart) { _InputDic; }
code_block_66 = CodeBlock { "BoxClass_fixedpart"; }
valueAtKey_29 = DesignScript.Builtin.Dictionary.ValueAtKey(dictionary=code_block_65, key=code_block_66)
code_block_67 = CodeBlock { "BoxZvalue"; }
valueAtKey_30 = DesignScript.Builtin.Dictionary.ValueAtKey(dictionary=valueAtKey_29, key=code_block_67)
uniqueItems_3 = List.UniqueItems(list=valueAtKey_30)
code_block_68 = CodeBlock { "BoxClass_fixedpart"; }
code_block_69 = CodeBlock { "BoxGeometry"; }
components = DesignScript.Builtin.Dictionary.Components(dictionary=valueAtKey_29)
addItemToEnd = List.AddItemToEnd(item=code_block_69, list=components.keys)
code_block_70 = CodeBlock { "GridPointOfBldgBoundary"; }
valueAtKey_31 = DesignScript.Builtin.Dictionary.ValueAtKey(dictionary=code_block_65, key=code_block_70)
code_block_71 = CodeBlock { "BoxSeed"; }
valueAtKey_32 = DesignScript.Builtin.Dictionary.ValueAtKey(dictionary=valueAtKey_29, key=code_block_71)
getItemAtIndex_17 = List.GetItemAtIndex(list=valueAtKey_31, index=valueAtKey_32)
X_4 = Point.X(point=getItemAtIndex_17)
Y_4 = Point.Y(point=getItemAtIndex_17)
firstItem_3 = List.FirstItem(list=valueAtKey_30)
code_block_72 = CodeBlock(i=valueAtKey_30, j=firstItem_3) { i+Math.Abs(j/2); }
byCoordinates_2 = Point.ByCoordinates(x=X_4, y=Y_4, z=code_block_72)
code_block_73 = CodeBlock { "BoxWidth"; }
valueAtKey_33 = DesignScript.Builtin.Dictionary.ValueAtKey(dictionary=valueAtKey_29, key=code_block_73)
code_block_74 = CodeBlock { "BoxLength"; }
valueAtKey_34 = DesignScript.Builtin.Dictionary.ValueAtKey(dictionary=valueAtKey_29, key=code_block_74)
code_block_75 = CodeBlock { "BoxHeight"; }
valueAtKey_35 = DesignScript.Builtin.Dictionary.ValueAtKey(dictionary=valueAtKey_29, key=code_block_75)
byLengths = Cuboid.ByLengths(origin=byCoordinates_2, width=valueAtKey_33, length=valueAtKey_34, height=valueAtKey_35)
centroid = Solid.Centroid(solid=byLengths)
ZAxis = Vector.ZAxis()
code_block_76 = CodeBlock { "BoxClass_Primary"; }
valueAtKey_36 = DesignScript.Builtin.Dictionary.ValueAtKey(dictionary=code_block_65, key=code_block_76)
code_block_77 = CodeBlock { "BoxDepartment"; }
valueAtKey_37 = DesignScript.Builtin.Dictionary.ValueAtKey(dictionary=valueAtKey_36, key=code_block_77)
code_block_78 = CodeBlock()
# ---------- code_block_78.designscript (6 lines) ----------
[
"PATHV1",
"PATHV2",
"PATHV3"
];
[];
# ----------------------------------------
contains = String.Contains(str=valueAtKey_37, searchFor=code_block_78.out0@@L1)
boolean_2 = BoolSelector(true)
allIndicesOf_2 = List.AllIndicesOf(list=contains@@L2, item=boolean_2)
count = List.Count(list=allIndicesOf_2)
code_block_79 = CodeBlock { 0; }
code_block_80 = CodeBlock { 90; }
code_block_81 = CodeBlock { "RotatingSeed"; }
valueAtKey_38 = DesignScript.Builtin.Dictionary.ValueAtKey(dictionary=code_block_65, key=code_block_81)
randomList = Math.RandomList(amount=count, value1=code_block_79, value2=code_block_80, seed=valueAtKey_38)
code_block_82 = CodeBlock(i=randomList) { i>=45; }
code_block_83 = CodeBlock { 90; 0; }
if_ = If(test=code_block_82, true=code_block_83.out0, false=code_block_83.out1)
count_2 = List.Count(list=allIndicesOf_2@L2)
ofRepeatedItem = List.OfRepeatedItem(item=if_@L1, amount=count_2@L1)
flatten_14 = List.Flatten(list=ofRepeatedItem)
rotate = Geometry.Rotate(geometry=byLengths, origin=centroid, axis=ZAxis, degrees=flatten_14)
addItemToEnd_2 = List.AddItemToEnd(item=rotate, list=components.values)
byKeysValues_2 = DesignScript.Builtin.Dictionary.ByKeysValues(keys=addItemToEnd, values=addItemToEnd_2)
setValueAtKeys = DesignScript.Builtin.Dictionary.SetValueAtKeys(dictionary=code_block_65, keys=code_block_68, values=byKeysValues_2)

# group: 레벨 별 고정부 비점유 포인트 추출
code_block_84 = CodeBlock(InputDic=setValueAtKeys) { _InputDic; }
code_block_85 = CodeBlock { "GridPointOfBldgBoundary"; }
valueAtKey_39 = DesignScript.Builtin.Dictionary.ValueAtKey(dictionary=code_block_84, key=code_block_85)
X_5 = Point.X(point=valueAtKey_39)
Y_5 = Point.Y(point=valueAtKey_39)
code_block_86 = CodeBlock { "BoxClass_fixedpart"; }
valueAtKey_40 = DesignScript.Builtin.Dictionary.ValueAtKey(dictionary=code_block_84, key=code_block_86)
code_block_87 = CodeBlock { "BoxZvalue"; }
valueAtKey_41 = DesignScript.Builtin.Dictionary.ValueAtKey(dictionary=valueAtKey_40, key=code_block_87)
uniqueItems_4 = List.UniqueItems(list=valueAtKey_41)
byCoordinates_3 = Point.ByCoordinates(x=X_5, y=Y_5, z=uniqueItems_4@L1)
code_block_88 = CodeBlock { "BoxGeometry"; }
valueAtKey_42 = DesignScript.Builtin.Dictionary.ValueAtKey(dictionary=valueAtKey_40, key=code_block_88)
byUnion = Solid.ByUnion(solids=valueAtKey_42)
doesIntersect_2 = Geometry.DoesIntersect(geometry=byCoordinates_3, other=byUnion)
filterByBoolMask_2 = List.FilterByBoolMask(list=byCoordinates_3@L2, mask=doesIntersect_2@L2)
watch_4 = Watch(filterByBoolMask_2.out)
code_block_89 = CodeBlock(RestGridPointByLevel=watch_4)
# ---------- code_block_89.designscript (3 lines) ----------
{
"RestGridPointByLevel": _RestGridPointByLevel
};
# ----------------------------------------
extendsChildDictionaryFromParent_7 = Custom[ExtendsChildDictionaryFromParent](ParentDic=code_block_84, ChildDic=code_block_89)

code_block_90 = CodeBlock(i=filterByBoolMask_2.out) { i; }
