# Dynamo custom node FindNonFixedPartBox.dyf (Dynamo 2.10.1.3976)
# category: mQSpace
# FindNonFixedPartBox

InputDic = Input(_InputDic: var[]..[])

# group: Non-Fixed Part 종류별 카운팅
code_block = CodeBlock(InputDic=InputDic) { _InputDic; }
code_block_2 = CodeBlock { "BoxClass_Primary"; }
valueAtKey = DesignScript.Builtin.Dictionary.ValueAtKey(dictionary=code_block, key=code_block_2)
components = DesignScript.Builtin.Dictionary.Components(dictionary=valueAtKey)
transpose = List.Transpose(lists=components.values)
code_block_3 = CodeBlock { "BoxSpaceID"; }
valueAtKey_2 = DesignScript.Builtin.Dictionary.ValueAtKey(dictionary=valueAtKey, key=code_block_3)
code_block_4 = CodeBlock { "BoxClass_fixedpart"; }
valueAtKey_3 = DesignScript.Builtin.Dictionary.ValueAtKey(dictionary=code_block, key=code_block_4)
code_block_5 = CodeBlock { "BoxSpaceID"; }
valueAtKey_4 = DesignScript.Builtin.Dictionary.ValueAtKey(dictionary=valueAtKey_3, key=code_block_5)
setDifference = List.SetDifference(list1=valueAtKey_2, list2=valueAtKey_4)
getItemAtIndex = List.GetItemAtIndex(list=transpose, index=setDifference)
transpose_2 = List.Transpose(lists=getItemAtIndex)
byKeysValues = DesignScript.Builtin.Dictionary.ByKeysValues(keys=components.keys, values=transpose_2)
code_block_6 = CodeBlock(BoxClass_nonfixedpart=byKeysValues)
# ---------- code_block_6.designscript (3 lines) ----------
{
"BoxClass_nonfixedpart": _BoxClass_nonfixedpart
};
# ----------------------------------------
extendsChildDictionaryFromParent = Custom[ExtendsChildDictionaryFromParent](ParentDic=code_block, ChildDic=code_block_6)  # Extends Child Dictionary From Parent

dictionary = Output(extendsChildDictionaryFromParent.dictionary)
