# Dynamo custom node SetBoxZvalueProp.dyf (Dynamo 2.10.1.3976)
# category: mQSpace
# SetBoxZvalueProp

InputDic = Input(_InputDic: var[]..[])

# group: Box 프로퍼티에 BoxZvalue추가(Level에 따라 Z 값 Dictionary 추출)
code_block = CodeBlock(InputDic=InputDic) { _InputDic; }
code_block_2 = CodeBlock { "BoxClass_Primary"; }
valueAtKey = DesignScript.Builtin.Dictionary.ValueAtKey(dictionary=code_block, key=code_block_2)
code_block_3 = CodeBlock { "BoxLevel"; }
valueAtKey_2 = DesignScript.Builtin.Dictionary.ValueAtKey(dictionary=valueAtKey, key=code_block_3)
lev = Watch(valueAtKey_2)
uniqueItems = List.UniqueItems(list=lev)
code_block_4 = CodeBlock { "FloorLevel"; }
valueAtKey_3 = DesignScript.Builtin.Dictionary.ValueAtKey(dictionary=code_block, key=code_block_4)
byKeysValues = DesignScript.Builtin.Dictionary.ByKeysValues(keys=uniqueItems, values=valueAtKey_3)
watch = Watch(byKeysValues)
valueAtKey_4 = DesignScript.Builtin.Dictionary.ValueAtKey(dictionary=watch, key=lev)
z_값_lev_에서_추출 = Watch(valueAtKey_4)
boxclass_primary에_boxzvalue_추가 = CodeBlock(BoxZvalue=z_값_lev_에서_추출)
# ---------- boxclass_primary에_boxzvalue_추가.designscript (3 lines) ----------
{
"BoxZvalue": _BoxZvalue
};
# ----------------------------------------
extendsChildDictionaryFromParent = Custom[ExtendsChildDictionaryFromParent](ParentDic=valueAtKey, ChildDic=boxclass_primary에_boxzvalue_추가)  # Extends Child Dictionary From Parent
setValueAtKeys = DesignScript.Builtin.Dictionary.SetValueAtKeys(dictionary=code_block, keys=code_block_2, values=extendsChildDictionaryFromParent.dictionary)

dictionary = Output(setValueAtKeys)
