# Dynamo graph 1006 space planning test_mk.dyn (Dynamo 2.10.1.3976)
# packages: GenerativeDesign.Revit 1.7.3.0, GenerativeDesign 1.7.3.0

# group: User Inputs for GDIR
# note: Custom Package: GenerativeDesign v.2021.5.5
select_room_to_load_program_into = DSModelRoomSelection()  # 1 picked in the model; graph input
# note: Retrieve the room's finish boundary.
# Note: The first sublist is the outermost boundary of the room.
finishBoundary = Room.FinishBoundary(room=select_room_to_load_program_into)
remember = Data.Remember(finishBoundary)

# group: Extract room boundary for DynaSpace and cache it in the graph
firstItem = List.FirstItem(list=remember@L3)
startPoint = Curve.StartPoint(curve=firstItem)
flatten = List.Flatten(list=startPoint)
byJoinedCurves = PolyCurve.ByJoinedCurves(curves=firstItem)
code_block = CodeBlock(BldgBoundary=byJoinedCurves)
# ---------- code_block.designscript (3 lines) ----------
{
"BldgBoundary": _BldgBoundary
};
# ----------------------------------------

# group: 고정부 Seed
seed_고정부_코어 = DoubleSlider(422, range=0..999 step 1)  # graph input

# group: 변동부 Seed
seed_변형부_공간 = DoubleSlider(330, range=0..999 step 1)  # graph input

# group: 회전 Seed
seed_회전용 = DoubleSlider(379, range=0..999 step 1)  # graph input

# group: Floor Level
code_block_2 = CodeBlock { [-6000, 0, 6000, 12000]; }

code_block_3 = CodeBlock(FixedPartSeed=seed_고정부_코어, NonFixedPartSeed=seed_변형부_공간, RotatingSeed=seed_회전용, FloorLevel=code_block_2)
# ---------- code_block_3.designscript (6 lines) ----------
{
"FixedPartSeed": _FixedPartSeed,
"NonFixedPartSeed": _NonFixedPartSeed,
"RotatingSeed": _RotatingSeed,
"FloorLevel": _FloorLevel
};
# ----------------------------------------
extendsChildDictionaryFromParent = Custom[ExtendsChildDictionaryFromParent](ParentDic=code_block, ChildDic=code_block_3)  # Extends Child Dictionary From Parent

# group: Excel Data import (package 정리 전)
file_path = Filename("상상진화\20210824\space planning test 0802mk 001.xlsx")
file_from_path = FileObject(path=file_path)
string_from_object = FromObject(object=file_from_path)
code_block_4 = CodeBlock { "Sheet1"; "SampleBuildingProgram-Clinic"; false; }
python_script_import_excel_by = Python(IN[0]=string_from_object, IN[1]=code_block_4.out0)  # "Python Script@Import Excel(By OpenpyXl)"; CPython3
# ---------- python_script_import_excel_by.python (50 lines) ----------
# Load the Python Standard and DesignScript Libraries
import sys
import os
#sys.path.append(r'C:\Users\HEC\AppData\Local\Programs\Python\Python39\Lib\site-packages')
#sys.path.append(r'C:\Users\pjmk0\AppData\Local\Programs\Python\Python39\Lib\site-packages')
sys.path.append(os.getenv('LOCALAPPDATA').replace('\\','\\\\') + r'\Programs\Python\Python39\Lib\site-packages')
import clr
clr.AddReference('ProtoGeometry')
from Autodesk.DesignScript.Geometry import *
from collections import Iterable

def iterable(obj):
    return isinstance(obj, Iterable)


# The inputs to this node will be stored as a list in the IN variables.
dataEnteringNode = IN
PathIn = IN[0]
SheetNameIn = IN[1]

# Place your code below this line
import datetime
import openpyxl

path = (PathIn)
#path = (r'C:\Users\pjmk0\Downloads\MK\mQ\BIM_물량집계 자동화 산출기준표_rC(20210607)_mk_de.xlsx')

wb_obj = openpyxl.load_workbook(path, data_only=True)
sheet_obj = wb_obj.get_sheet_by_name(SheetNameIn)

m_row = sheet_obj.max_row
m_col = sheet_obj.max_column

listOut = []



for i in range(1, m_row +1):
    listTemp = []
    for j in range(1, m_col + 1):
        cell_obj = sheet_obj.cell(row=i, column=j)
        listTemp.append(cell_obj.value)
        if len(listTemp) == m_col:
            listOut.append(listTemp)
        


# Assign your output to the OUT variable.
OUT = listOut
#OUT = os.getenv('APPDATA')
# ----------------------------------------
excel_data_정리_전 = Watch(python_script_import_excel_by)

remember_2 = Data.Remember(excel_data_정리_전)

# group: Excel List 분할
excel_data_정리_전_2 = Watch(remember_2)
transpose = List.Transpose(lists=excel_data_정리_전_2)
# note: List Name 정리
code_block_5 = CodeBlock { 1; }
dropItems = List.DropItems(list=transpose@L2, amount=code_block_5)
watch = Watch(dropItems)
code_block_6 = CodeBlock { 0; }
getItemAtIndex = List.GetItemAtIndex(list=watch, index=code_block_6)
space_id = Watch(getItemAtIndex)
code_block_7 = CodeBlock { 1; }
getItemAtIndex_2 = List.GetItemAtIndex(list=watch, index=code_block_7)
space_name = Watch(getItemAtIndex_2)
code_block_8 = CodeBlock { 10; }
getItemAtIndex_3 = List.GetItemAtIndex(list=watch, index=code_block_8)
adjacent_spaces = Watch(getItemAtIndex_3)
code_block_9 = CodeBlock { 3; }
getItemAtIndex_4 = List.GetItemAtIndex(list=watch, index=code_block_9)
department_id = Watch(getItemAtIndex_4)
code_block_10 = CodeBlock { 2; }
getItemAtIndex_5 = List.GetItemAtIndex(list=watch, index=code_block_10)
DEPARTMENT = Watch(getItemAtIndex_5)
code_block_11 = CodeBlock { 11; }
getItemAtIndex_6 = List.GetItemAtIndex(list=watch, index=code_block_11)
lev = Watch(getItemAtIndex_6)
code_block_12 = CodeBlock { 5; }
getItemAtIndex_7 = List.GetItemAtIndex(list=watch, index=code_block_12)
WIDTH = Watch(getItemAtIndex_7)
code_block_13 = CodeBlock { 6; }
getItemAtIndex_8 = List.GetItemAtIndex(list=watch, index=code_block_13)
length = Watch(getItemAtIndex_8)
code_block_14 = CodeBlock { 7; }
getItemAtIndex_9 = List.GetItemAtIndex(list=watch, index=code_block_14)
height = Watch(getItemAtIndex_9)
code_block_15 = CodeBlock { 8; }
getItemAtIndex_10 = List.GetItemAtIndex(list=watch, index=code_block_15)
AREA = Watch(getItemAtIndex_10)
code_block_16 = CodeBlock { 14; }
getItemAtIndex_11 = List.GetItemAtIndex(list=watch, index=code_block_16)
ROTATE = Watch(getItemAtIndex_11)
code_block_17 = CodeBlock { 15; }
getItemAtIndex_12 = List.GetItemAtIndex(list=watch, index=code_block_17)
CLUSTER = Watch(getItemAtIndex_12)
code_block_18 = CodeBlock(ExcelDataWithNoHead=watch, SpaceID=space_id, SpaceName=space_name, AdjacentSpaces=adjacent_spaces, DepartmentID=department_id, Department=DEPARTMENT, Level=lev, Width=WIDTH, Length=length, Height=height, Area=AREA, Rotate=ROTATE, Cluster=CLUSTER)
# ---------- code_block_18.designscript (15 lines) ----------
{
"ExcelDataWithNoHead": _ExcelDataWithNoHead,
"SpaceID": _SpaceID,
"SpaceName": _SpaceName,
"AdjacentSpaces": _AdjacentSpaces,
"DepartmentID": _DepartmentID,
"Department": _Department,
"Level": _Level,
"Width": _Width,
"Length": _Length,
"Height": _Height,
"Area": _Area,
"Rotate": _Rotate,
"Cluster": _Cluster
};
# ----------------------------------------

code_block_19 = CodeBlock(InputDic=code_block_18) { _InputDic; }
code_block_20 = CodeBlock { "SpaceID"; }
valueAtKey = DesignScript.Builtin.Dictionary.ValueAtKey(dictionary=code_block_19, key=code_block_20)
code_block_21 = CodeBlock { "SpaceName"; }
valueAtKey_2 = DesignScript.Builtin.Dictionary.ValueAtKey(dictionary=code_block_19, key=code_block_21)
code_block_22 = CodeBlock { "AdjacentSpaces"; }
valueAtKey_3 = DesignScript.Builtin.Dictionary.ValueAtKey(dictionary=code_block_19, key=code_block_22)
code_block_23 = CodeBlock { "DepartmentID"; }
valueAtKey_4 = DesignScript.Builtin.Dictionary.ValueAtKey(dictionary=code_block_19, key=code_block_23)
code_block_24 = CodeBlock { "Department"; }
valueAtKey_5 = DesignScript.Builtin.Dictionary.ValueAtKey(dictionary=code_block_19, key=code_block_24)
code_block_25 = CodeBlock { "Level"; }
valueAtKey_6 = DesignScript.Builtin.Dictionary.ValueAtKey(dictionary=code_block_19, key=code_block_25)
code_block_26 = CodeBlock { "Width"; }
valueAtKey_7 = DesignScript.Builtin.Dictionary.ValueAtKey(dictionary=code_block_19, key=code_block_26)
code_block_27 = CodeBlock { "Length"; }
valueAtKey_8 = DesignScript.Builtin.Dictionary.ValueAtKey(dictionary=code_block_19, key=code_block_27)
code_block_28 = CodeBlock { "Height"; }
valueAtKey_9 = DesignScript.Builtin.Dictionary.ValueAtKey(dictionary=code_block_19, key=code_block_28)
code_block_29 = CodeBlock { "Area"; }
valueAtKey_10 = DesignScript.Builtin.Dictionary.ValueAtKey(dictionary=code_block_19, key=code_block_29)
code_block_30 = CodeBlock { "Rotate"; }
valueAtKey_11 = DesignScript.Builtin.Dictionary.ValueAtKey(dictionary=code_block_19, key=code_block_30)
code_block_31 = CodeBlock { "Cluster"; }
valueAtKey_12 = DesignScript.Builtin.Dictionary.ValueAtKey(dictionary=code_block_19, key=code_block_31)
code_block_32 = CodeBlock(BoxSpaceID=valueAtKey, BoxSpaceName=valueAtKey_2, BoxAdjacentSpaces=valueAtKey_3, BoxDepartmentID=valueAtKey_4, BoxDepartment=valueAtKey_5, BoxLevel=valueAtKey_6, BoxWidth=valueAtKey_7, BoxLength=valueAtKey_8, BoxHeight=valueAtKey_9, BoxArea=valueAtKey_10, BoxRotate=valueAtKey_11, BoxCluster=valueAtKey_12)
# ---------- code_block_32.designscript (15 lines) ----------
///Box Class Primary
{
"BoxSpaceID": _BoxSpaceID,
"BoxSpaceName": _BoxSpaceName,
"BoxAdjacentSpaces": _BoxAdjacentSpaces,
"BoxDepartmentID": _BoxDepartmentID,
"BoxDepartment": _BoxDepartment,
"BoxLevel": _BoxLevel,
"BoxWidth": _BoxWidth,
"BoxLength": _BoxLength,
"BoxHeight": _BoxHeight,
"BoxArea": _BoxArea,
"BoxRotate": _BoxRotate,
"BoxCluster": _BoxCluster
};
# ----------------------------------------
code_block_33 = CodeBlock(BoxClass_Primary=code_block_32)
# ---------- code_block_33.designscript (3 lines) ----------
{
"BoxClass_Primary": _BoxClass_Primary
};
# ----------------------------------------
extendsChildDictionaryFromParent_2 = Custom[ExtendsChildDictionaryFromParent](ParentDic=extendsChildDictionaryFromParent.dictionary, ChildDic=code_block_33)
watch_2 = Watch(extendsChildDictionaryFromParent_2.key)
code_block_34 = CodeBlock(InputDic=extendsChildDictionaryFromParent_2.dictionary) { _InputDic; }
setBoxZvalueProp = Custom[SetBoxZvalueProp](InputDic=code_block_34)  # SetBoxZvalueProp

# group: 룸 BoundingBox 그리드 포인트 생성
code_block_35 = CodeBlock(InputDic=setBoxZvalueProp) { _InputDic; }
code_block_36 = CodeBlock { "BldgBoundary"; }
valueAtKey_13 = DesignScript.Builtin.Dictionary.ValueAtKey(dictionary=code_block_35, key=code_block_36)
byGeometry = BoundingBox.ByGeometry(geom=valueAtKey_13)
minPoint = BoundingBox.MinPoint(boundingBox=byGeometry)
X = Point.X(point=minPoint)
maxPoint = BoundingBox.MaxPoint(boundingBox=byGeometry)
X_2 = Point.X(point=maxPoint)
code_block_37 = CodeBlock { 500; }
code_block_38 = CodeBlock(a=X, b=X_2, x=code_block_37) { a..b..x; }
Y = Point.Y(point=minPoint)
Y_2 = Point.Y(point=maxPoint)
code_block_39 = CodeBlock { 500; }
code_block_40 = CodeBlock(a=Y, b=Y_2, x=code_block_39) { a..b..x; }
byCoordinates = Point.ByCoordinates(x=code_block_38, y=code_block_40, lacing=CrossProduct)
flatten_2 = List.Flatten(list=byCoordinates)
code_block_41 = CodeBlock(GridPointOfBldgBoundary=flatten_2)
# ---------- code_block_41.designscript (3 lines) ----------
{
"GridPointOfBldgBoundary": _GridPointOfBldgBoundary
};
# ----------------------------------------
extendsChildDictionaryFromParent_3 = Custom[ExtendsChildDictionaryFromParent](ParentDic=code_block_35, ChildDic=code_block_41)

# group: DistributeRandomSeedForFixedPart
code_block_42 = CodeBlock(InputDic=extendsChildDictionaryFromParent_3.dictionary) { _InputDic; }
distributeRandomSeedForFixedPart = Custom[DistributeRandomSeedForFixedPart](InputDic=code_block_42)  # DistributeRandomSeedForFixedPart

# group: Fixed Part 형상 배치 by Seed(회전 고려)
code_block_43 = CodeBlock(InputDic=distributeRandomSeedForFixedPart) { _InputDic; }
code_block_44 = CodeBlock { "BoxClass_fixedpart"; }
valueAtKey_14 = DesignScript.Builtin.Dictionary.ValueAtKey(dictionary=code_block_43, key=code_block_44)
code_block_45 = CodeBlock { "BoxZvalue"; }
valueAtKey_15 = DesignScript.Builtin.Dictionary.ValueAtKey(dictionary=valueAtKey_14, key=code_block_45)
uniqueItems = List.UniqueItems(list=valueAtKey_15)
code_block_46 = CodeBlock { "BoxClass_fixedpart"; }
code_block_47 = CodeBlock { "BoxGeometry"; }
components = DesignScript.Builtin.Dictionary.Components(dictionary=valueAtKey_14)
addItemToEnd = List.AddItemToEnd(item=code_block_47, list=components.keys)
code_block_48 = CodeBlock { "GridPointOfBldgBoundary"; }
valueAtKey_16 = DesignScript.Builtin.Dictionary.ValueAtKey(dictionary=code_block_43, key=code_block_48)
code_block_49 = CodeBlock { "BoxSeed"; }
valueAtKey_17 = DesignScript.Builtin.Dictionary.ValueAtKey(dictionary=valueAtKey_14, key=code_block_49)
getItemAtIndex_13 = List.GetItemAtIndex(list=valueAtKey_16, index=valueAtKey_17)
X_3 = Point.X(point=getItemAtIndex_13)
Y_3 = Point.Y(point=getItemAtIndex_13)
firstItem_2 = List.FirstItem(list=valueAtKey_15)
code_block_50 = CodeBlock(i=valueAtKey_15, j=firstItem_2) { i+Math.Abs(j/2); }
byCoordinates_2 = Point.ByCoordinates(x=X_3, y=Y_3, z=code_block_50)
code_block_51 = CodeBlock { "BoxWidth"; }
valueAtKey_18 = DesignScript.Builtin.Dictionary.ValueAtKey(dictionary=valueAtKey_14, key=code_block_51)
code_block_52 = CodeBlock { "BoxLength"; }
valueAtKey_19 = DesignScript.Builtin.Dictionary.ValueAtKey(dictionary=valueAtKey_14, key=code_block_52)
code_block_53 = CodeBlock { "BoxHeight"; }
valueAtKey_20 = DesignScript.Builtin.Dictionary.ValueAtKey(dictionary=valueAtKey_14, key=code_block_53)
byLengths = Cuboid.ByLengths(origin=byCoordinates_2, width=valueAtKey_18, length=valueAtKey_19, height=valueAtKey_20)
centroid = Solid.Centroid(solid=byLengths)
ZAxis = Vector.ZAxis()
code_block_54 = CodeBlock { "BoxClass_Primary"; }
valueAtKey_21 = DesignScript.Builtin.Dictionary.ValueAtKey(dictionary=code_block_43, key=code_block_54)
code_block_55 = CodeBlock { "BoxDepartment"; }
valueAtKey_22 = DesignScript.Builtin.Dictionary.ValueAtKey(dictionary=valueAtKey_21, key=code_block_55)
code_block_56 = CodeBlock()
# ---------- code_block_56.designscript (6 lines) ----------
[
"PATHV1",
"PATHV2",
"PATHV3"
];
[];
# ----------------------------------------
contains = String.Contains(str=valueAtKey_22, searchFor=code_block_56.out0@@L1)
boolean = BoolSelector(true)
allIndicesOf = List.AllIndicesOf(list=contains@@L2, item=boolean)
count = List.Count(list=allIndicesOf)
code_block_57 = CodeBlock { 0; }
code_block_58 = CodeBlock { 90; }
code_block_59 = CodeBlock { "RotatingSeed"; }
valueAtKey_23 = DesignScript.Builtin.Dictionary.ValueAtKey(dictionary=code_block_43, key=code_block_59)
randomList = Math.RandomList(amount=count, value1=code_block_57, value2=code_block_58, seed=valueAtKey_23)
code_block_60 = CodeBlock(i=randomList) { i>=45; }
code_block_61 = CodeBlock { 90; 0; }
if_ = If(test=code_block_60, true=code_block_61.out0, false=code_block_61.out1)
count_2 = List.Count(list=allIndicesOf@L2)
ofRepeatedItem = List.OfRepeatedItem(item=if_@L1, amount=count_2@L1)
flatten_3 = List.Flatten(list=ofRepeatedItem)
rotate = Geometry.Rotate(geometry=byLengths, origin=centroid, axis=ZAxis, degrees=flatten_3)
addItemToEnd_2 = List.AddItemToEnd(item=rotate, list=components.values)
byKeysValues = DesignScript.Builtin.Dictionary.ByKeysValues(keys=addItemToEnd, values=addItemToEnd_2)
setValueAtKeys = DesignScript.Builtin.Dictionary.SetValueAtKeys(dictionary=code_block_43, keys=code_block_46, values=byKeysValues)

# group: 레벨 별 고정부 비점유 포인트 추출
code_block_62 = CodeBlock(InputDic=setValueAtKeys) { _InputDic; }
code_block_63 = CodeBlock { "GridPointOfBldgBoundary"; }
valueAtKey_24 = DesignScript.Builtin.Dictionary.ValueAtKey(dictionary=code_block_62, key=code_block_63)
X_4 = Point.X(point=valueAtKey_24)
Y_4 = Point.Y(point=valueAtKey_24)
code_block_64 = CodeBlock { "BoxClass_fixedpart"; }
valueAtKey_25 = DesignScript.Builtin.Dictionary.ValueAtKey(dictionary=code_block_62, key=code_block_64)
code_block_65 = CodeBlock { "BoxZvalue"; }
valueAtKey_26 = DesignScript.Builtin.Dictionary.ValueAtKey(dictionary=valueAtKey_25, key=code_block_65)
uniqueItems_2 = List.UniqueItems(list=valueAtKey_26)
byCoordinates_3 = Point.ByCoordinates(x=X_4, y=Y_4, z=uniqueItems_2@L1)
code_block_66 = CodeBlock { "BoxGeometry"; }
valueAtKey_27 = DesignScript.Builtin.Dictionary.ValueAtKey(dictionary=valueAtKey_25, key=code_block_66)
byUnion = Solid.ByUnion(solids=valueAtKey_27)
doesIntersect = Geometry.DoesIntersect(geometry=byCoordinates_3, other=byUnion)
filterByBoolMask = List.FilterByBoolMask(list=byCoordinates_3@L2, mask=doesIntersect@L2)
watch_3 = Watch(filterByBoolMask.out)
code_block_67 = CodeBlock(RestGridPointByLevel=watch_3)
# ---------- code_block_67.designscript (3 lines) ----------
{
"RestGridPointByLevel": _RestGridPointByLevel
};
# ----------------------------------------
extendsChildDictionaryFromParent_4 = Custom[ExtendsChildDictionaryFromParent](ParentDic=code_block_62, ChildDic=code_block_67)

code_block_68 = CodeBlock(i=filterByBoolMask.out) { i; }

# group: FindNonFixedPartBox
code_block_69 = CodeBlock(InputDic=extendsChildDictionaryFromParent_4.dictionary) { _InputDic; }
findNonFixedPartBox = Custom[FindNonFixedPartBox](InputDic=code_block_69)  # FindNonFixedPartBox

# group: DistributeRandomSeedForNonFixedPart
code_block_70 = CodeBlock(InputDic=findNonFixedPartBox) { _InputDic; }
distributeRandomSeedForNonFixedPart = Custom[DistributeRandomSeedForNonFixedPart](InputDic=code_block_70)  # DistributeRandomSeedForNonFixedPart

# group: 비 고정부 클러스터링 딕셔너리 형성
code_block_71 = CodeBlock(InputDic=distributeRandomSeedForNonFixedPart) { _InputDic; }
code_block_72 = CodeBlock { "BoxClass_nonfixedpart"; }
valueAtKey_28 = DesignScript.Builtin.Dictionary.ValueAtKey(dictionary=code_block_71, key=code_block_72)
code_block_73 = CodeBlock { "BoxCluster"; }
valueAtKey_29 = DesignScript.Builtin.Dictionary.ValueAtKey(dictionary=valueAtKey_28, key=code_block_73)
uniqueItems_3 = List.UniqueItems(list=valueAtKey_29)
list_allindicesof = List.AllIndicesOf(list=valueAtKey_29, item=uniqueItems_3)
count_3 = List.Count(list=list_allindicesof@L2)
components_2 = DesignScript.Builtin.Dictionary.Components(dictionary=valueAtKey_28)
getItemAtIndex_14 = List.GetItemAtIndex(list=components_2.values@L2, index=list_allindicesof)
byKeysValues_2 = DesignScript.Builtin.Dictionary.ByKeysValues(keys=components_2.keys, values=getItemAtIndex_14)
code_block_74 = CodeBlock(BoxClass_nonfixedclu=byKeysValues_2)
# ---------- code_block_74.designscript (3 lines) ----------
{
"BoxClass_nonfixedclustered": _BoxClass_nonfixedclustered
};
# ----------------------------------------
extendsChildDictionaryFromParent_5 = Custom[ExtendsChildDictionaryFromParent](ParentDic=code_block_71, ChildDic=code_block_74)

# group: 클러스터별 지오메트리 형성(랜덤회전 반영)
code_block_75 = CodeBlock(InputDic=extendsChildDictionaryFromParent_5.dictionary) { _InputDic; }
code_block_76 = CodeBlock { "BldgBoundary"; }
valueAtKey_30 = DesignScript.Builtin.Dictionary.ValueAtKey(dictionary=code_block_75, key=code_block_76)
code_block_77 = CodeBlock { "BoxClass_nonfixedclustered"; }
code_block_78 = CodeBlock { "BoxClass_nonfixedclustered"; }
valueAtKey_31 = DesignScript.Builtin.Dictionary.ValueAtKey(dictionary=code_block_75, key=code_block_78)
code_block_79 = CodeBlock { "BoxWidth"; }
valueAtKey_32 = DesignScript.Builtin.Dictionary.ValueAtKey(dictionary=valueAtKey_31, key=code_block_79)
code_block_80 = CodeBlock { "BoxLength"; }
valueAtKey_33 = DesignScript.Builtin.Dictionary.ValueAtKey(dictionary=valueAtKey_31, key=code_block_80)
byWidthLength = Rectangle.ByWidthLength(width=valueAtKey_32, length=valueAtKey_33)
center = Polygon.Center(polygon=byWidthLength)
ZAxis_2 = Vector.ZAxis()
code_block_81 = CodeBlock { [0,90,180,270]; }
count_4 = List.Count(list=byWidthLength@L2)
code_block_82 = CodeBlock { 0; 3; }
count_5 = List.Count(list=count_4@L2)
code_block_83 = CodeBlock { 0; 999; }
code_block_84 = CodeBlock { "RotatingSeed"; }
valueAtKey_34 = DesignScript.Builtin.Dictionary.ValueAtKey(dictionary=code_block_75, key=code_block_84)
randomList_2 = Math.RandomList(amount=count_5, value1=code_block_83.out0, value2=code_block_83.out1, seed=valueAtKey_34)
randomList_3 = Math.RandomList(amount=count_4@L2, value1=code_block_82.out0, value2=code_block_82.out1, seed=randomList_2@L2)
round = Math.Round(number=randomList_3)
getItemAtIndex_15 = List.GetItemAtIndex(list=code_block_81, index=round)
flatten_4 = List.Flatten(list=getItemAtIndex_15@L2)
rotate_2 = Geometry.Rotate(geometry=byWidthLength, origin=center, axis=ZAxis_2, degrees=flatten_4)
code_block_85 = CodeBlock(RotatedRectangle=rotate_2)
# ---------- code_block_85.designscript (3 lines) ----------
{
"RotatedRectangle": _RotatedRectangle
};
# ----------------------------------------
extendsChildDictionaryFromParent_6 = Custom[ExtendsChildDictionaryFromParent](ParentDic=valueAtKey_31, ChildDic=code_block_85)
setValueAtKeys_2 = DesignScript.Builtin.Dictionary.SetValueAtKeys(dictionary=code_block_75, keys=code_block_77, values=extendsChildDictionaryFromParent_6.dictionary)

# group: Bldg 장변 방향 종속 Space 처리
code_block_86 = CodeBlock(InputDic=setValueAtKeys_2) { _InputDic; }
code_block_87 = CodeBlock { "BoxClass_nonfixedclustered"; }
removeKeys = DesignScript.Builtin.Dictionary.RemoveKeys(dictionary=code_block_86, keys=code_block_87)
code_block_88 = CodeBlock { "BoxClass_nonfixedclustered"; }
valueAtKey_35 = DesignScript.Builtin.Dictionary.ValueAtKey(dictionary=code_block_86, key=code_block_88)
code_block_89 = CodeBlock { "RotatedRectangle"; }
removeKeys_2 = DesignScript.Builtin.Dictionary.RemoveKeys(dictionary=valueAtKey_35, keys=code_block_89)
code_block_90 = CodeBlock { "BoxRotate"; }
valueAtKey_36 = DesignScript.Builtin.Dictionary.ValueAtKey(dictionary=valueAtKey_35, key=code_block_90)
code_block_91 = CodeBlock(i=valueAtKey_36) { i==1?true:false; }
code_block_92 = CodeBlock { "RotatedRectangle"; }
valueAtKey_37 = DesignScript.Builtin.Dictionary.ValueAtKey(dictionary=valueAtKey_35, key=code_block_92)
rotatedRectangle = CodeBlock(RotatedRectangle=valueAtKey_37) { RotatedRectangle; }
center_2 = Polygon.Center(polygon=rotatedRectangle)
ZAxis_3 = Vector.ZAxis()
code_block_93 = CodeBlock { "BldgBoundary"; }
valueAtKey_38 = DesignScript.Builtin.Dictionary.ValueAtKey(dictionary=code_block_86, key=code_block_93)
explode = Geometry.Explode(geometry=valueAtKey_38)
flatten_5 = List.Flatten(list=explode)
direction = Line.Direction(line=flatten_5)
length_2 = Vector.Length(vector=direction)
maximumItem = List.MaximumItem(list=length_2)
indexOf = List.IndexOf(list=length_2, element=maximumItem)
getItemAtIndex_16 = List.GetItemAtIndex(list=direction, index=indexOf)
normalized = Vector.Normalized(vector=getItemAtIndex_16)
X_5 = Vector.X(vector=normalized)
round_2 = Math.Round(number=X_5)
Y_5 = Vector.Y(vector=normalized)
round_3 = Math.Round(number=Y_5)
code_block_94 = CodeBlock(i=round_2, j=round_3) { i<0 || j<0?true:false; }
reverse = Vector.Reverse(vector=normalized)
if_2 = If(test=code_block_94, true=reverse, false=normalized)
explode_2 = Geometry.Explode(geometry=valueAtKey_37)
flatten_6 = List.Flatten(list=explode_2@L2)
direction_2 = Line.Direction(line=flatten_6)
length_3 = Vector.Length(vector=direction_2)
maximumItem_2 = List.MaximumItem(list=length_3)
indexOf_2 = List.IndexOf(list=length_3@L2, element=maximumItem_2@L1)
getItemAtIndex_17 = List.GetItemAtIndex(list=direction_2@L2, index=indexOf_2@L1)
normalized_2 = Vector.Normalized(vector=getItemAtIndex_17)
X_6 = Vector.X(vector=normalized_2)
round_4 = Math.Round(number=X_6)
Y_6 = Vector.Y(vector=normalized_2)
round_5 = Math.Round(number=Y_6)
code_block_95 = CodeBlock(i=round_4, j=round_5) { i<0 || j<0?true:false; }
reverse_2 = Vector.Reverse(vector=normalized_2)
if_3 = If(test=code_block_95, true=reverse_2, false=normalized_2)
angleWithVector = Vector.AngleWithVector(vector=if_2, otherVector=if_3)
round_6 = Math.Round(number=angleWithVector)
rotate_3 = Geometry.Rotate(geometry=rotatedRectangle, origin=center_2, axis=ZAxis_3, degrees=round_6)
if_4 = If(test=code_block_91, true=rotate_3, false=rotatedRectangle)
code_block_96 = CodeBlock(RotatedRectangle=if_4)  # same code as code_block_85
extendsChildDictionaryFromParent_7 = Custom[ExtendsChildDictionaryFromParent](ParentDic=removeKeys_2, ChildDic=code_block_96)
code_block_97 = CodeBlock(BoxClass_nonfixedclu=extendsChildDictionaryFromParent_7.dictionary)  # same code as code_block_74
extendsChildDictionaryFromParent_8 = Custom[ExtendsChildDictionaryFromParent](ParentDic=removeKeys, ChildDic=code_block_97)

# group: 클러스터링 사각형들 Zvalue 맞춰 층별배치하기
code_block_98 = CodeBlock(InputDic=extendsChildDictionaryFromParent_8.dictionary) { _InputDic; }
code_block_99 = CodeBlock { "BoxClass_nonfixedclustered"; }
removeKeys_3 = DesignScript.Builtin.Dictionary.RemoveKeys(dictionary=code_block_98, keys=code_block_99)
code_block_100 = CodeBlock { "BoxClass_nonfixedclustered"; }
valueAtKey_39 = DesignScript.Builtin.Dictionary.ValueAtKey(dictionary=code_block_98, key=code_block_100)
code_block_101 = CodeBlock { "RotatedRectangle"; }
removeKeys_4 = DesignScript.Builtin.Dictionary.RemoveKeys(dictionary=valueAtKey_39, keys=code_block_101)
code_block_102 = CodeBlock { "RotatedRectangle"; }
valueAtKey_40 = DesignScript.Builtin.Dictionary.ValueAtKey(dictionary=valueAtKey_39, key=code_block_102)
code_block_103 = CodeBlock { "BoxZvalue"; }
valueAtKey_41 = DesignScript.Builtin.Dictionary.ValueAtKey(dictionary=valueAtKey_39, key=code_block_103)
translate = Geometry.Translate(geometry=valueAtKey_40, zTranslation=valueAtKey_41)
code_block_104 = CodeBlock(RotatedRectangle=translate)  # same code as code_block_85
extendsChildDictionaryFromParent_9 = Custom[ExtendsChildDictionaryFromParent](ParentDic=removeKeys_4, ChildDic=code_block_104)
code_block_105 = CodeBlock(BoxClass_nonfixedclu=extendsChildDictionaryFromParent_9.dictionary)  # same code as code_block_74
extendsChildDictionaryFromParent_10 = Custom[ExtendsChildDictionaryFromParent](ParentDic=removeKeys_3, ChildDic=code_block_105)

# group: 사각형 Surfaces 흔들어 배치
code_block_106 = CodeBlock(InputDic=extendsChildDictionaryFromParent_10.dictionary) { _InputDic; }
code_block_107 = CodeBlock { "BoxClass_nonfixedclustered"; }
removeKeys_5 = DesignScript.Builtin.Dictionary.RemoveKeys(dictionary=code_block_106, keys=code_block_107)
code_block_108 = CodeBlock { "BoxClass_nonfixedclustered"; }
valueAtKey_42 = DesignScript.Builtin.Dictionary.ValueAtKey(dictionary=code_block_106, key=code_block_108)
code_block_109 = CodeBlock { "RotatedRectangle"; }
valueAtKey_43 = DesignScript.Builtin.Dictionary.ValueAtKey(dictionary=valueAtKey_42, key=code_block_109)
byPatch = Surface.ByPatch(closedCurve=valueAtKey_43)
code_block_110 = CodeBlock { "BldgBoundary"; }
valueAtKey_44 = DesignScript.Builtin.Dictionary.ValueAtKey(dictionary=code_block_106, key=code_block_110)
watch_4 = Watch(valueAtKey_44)
byPatch_2 = Surface.ByPatch(closedCurve=watch_4)
code_block_111 = CodeBlock { 0.5; }
pointAtParameter = Surface.PointAtParameter(surface=byPatch_2, u=code_block_111, v=code_block_111)
X_7 = Point.X(point=pointAtParameter)
Y_7 = Point.Y(point=pointAtParameter)
Z = Point.Z(point=pointAtParameter)
byOrigin = CoordinateSystem.ByOrigin(x=X_7, y=Y_7, z=Z)
explode_3 = Geometry.Explode(geometry=watch_4)
length_4 = Curve.Length(curve=explode_3)
maximumItem_3 = List.MaximumItem(list=length_4)
minimumItem = List.MinimumItem(list=length_4)
shakeRoomSurfaces = Custom[ShakeRoomSurfaces](i=byPatch, CS=byOrigin, W=maximumItem_3, L=minimumItem)  # ShakeRoomSurfaces
flatten_7 = List.Flatten(list=shakeRoomSurfaces)
count_6 = List.Count(list=valueAtKey_43@L2)
chop = List.Chop(list=flatten_7, lengths=count_6)
code_block_112 = CodeBlock(ShakedSurfaces=chop)
# ---------- code_block_112.designscript (3 lines) ----------
{
"ShakedSurfaces": _ShakedSurfaces
};
# ----------------------------------------
extendsChildDictionaryFromParent_11 = Custom[ExtendsChildDictionaryFromParent](ParentDic=valueAtKey_42, ChildDic=code_block_112)
code_block_113 = CodeBlock(BoxClass_nonfixedclu=extendsChildDictionaryFromParent_11.dictionary)  # same code as code_block_74
extendsChildDictionaryFromParent_12 = Custom[ExtendsChildDictionaryFromParent](ParentDic=removeKeys_5, ChildDic=code_block_113)

# group: 부서별 색상 지정
code_block_114 = CodeBlock()
# ---------- code_block_114.designscript (6 lines) ----------
color1 = Color.ByARGB(200, 100, 0, 200);
color2 = Color.ByARGB(200, 0, 0, 0);
color3 = Color.ByARGB(200, 200, 0, 0);
color4 = Color.ByARGB(200, 0, 0, 200);
color5 = Color.ByARGB(200, 200, 0, 100);
color6 = Color.ByARGB(200, 0, 200, 0);
# ----------------------------------------
remember_3 = Data.Remember(code_block_114.color4)
remember_4 = Data.Remember(code_block_114.color5)
remember_5 = Data.Remember(code_block_114.color6)
code_block_115 = CodeBlock(InputDic=extendsChildDictionaryFromParent_12.dictionary) { _InputDic; }
code_block_116 = CodeBlock { "BoxClass_nonfixedclustered"; }
valueAtKey_45 = DesignScript.Builtin.Dictionary.ValueAtKey(dictionary=code_block_115, key=code_block_116)
code_block_117 = CodeBlock { "BoxDepartment"; }
valueAtKey_46 = DesignScript.Builtin.Dictionary.ValueAtKey(dictionary=valueAtKey_45, key=code_block_117)
watch_5 = Watch(valueAtKey_46)
uniqueItems_4 = List.UniqueItems(list=watch_5)
flatten_8 = List.Flatten(list=uniqueItems_4)
remember_6 = Data.Remember(code_block_114.color1)
remember_7 = Data.Remember(code_block_114.color2)
remember_8 = Data.Remember(code_block_114.color3)
join = List.Join(list0=remember_6, list1=remember_7, list2=remember_8)
byKeysValues_3 = DesignScript.Builtin.Dictionary.ByKeysValues(keys=flatten_8, values=join)
code_block_118 = CodeBlock(DepartmentColorDic=byKeysValues_3)
# ---------- code_block_118.designscript (3 lines) ----------
{
"DepartmentColorDic": _DepartmentColorDic
};
# ----------------------------------------
extendsChildDictionaryFromParent_13 = Custom[ExtendsChildDictionaryFromParent](ParentDic=code_block_115, ChildDic=code_block_118)

code_block_119 = CodeBlock { "BoxClass_nonfixedclustered"; }
code_block_120 = CodeBlock { "ShakedSurfaces"; }

# group: 사각 공간 색상 지정
code_block_121 = CodeBlock(InputDic=extendsChildDictionaryFromParent_13.dictionary) { _InputDic; }
code_block_122 = CodeBlock { "BoxHeight"; }
boolean_2 = BoolSelector(false)
code_block_123 = CodeBlock { "DepartmentColorDic"; }
valueAtKey_47 = DesignScript.Builtin.Dictionary.ValueAtKey(dictionary=code_block_121, key=code_block_123)
code_block_124 = CodeBlock { "BoxDepartment"; }
code_block_125 = CodeBlock { "BoxSpaceID"; }

valueAtKey_48 = DesignScript.Builtin.Dictionary.ValueAtKey(dictionary=code_block_121, key=code_block_119)

# group (continued): 사각 공간 색상 지정
valueAtKey_49 = DesignScript.Builtin.Dictionary.ValueAtKey(dictionary=valueAtKey_48, key=code_block_120)
valueAtKey_50 = DesignScript.Builtin.Dictionary.ValueAtKey(dictionary=valueAtKey_48, key=code_block_122)
thicken = Surface.Thicken(surface=valueAtKey_49, thickness=valueAtKey_50, both_sides=boolean_2)
valueAtKey_51 = DesignScript.Builtin.Dictionary.ValueAtKey(dictionary=valueAtKey_48, key=code_block_124)
valueAtKey_52 = DesignScript.Builtin.Dictionary.ValueAtKey(dictionary=valueAtKey_48, key=code_block_125)
flatten_9 = List.Flatten(list=valueAtKey_52)
code_block_126 = CodeBlock(RoomSolid=thicken)
# ---------- code_block_126.designscript (3 lines) ----------
{
"RoomSolid": _RoomSolid
};
# ----------------------------------------
extendsChildDictionaryFromParent_14 = Custom[ExtendsChildDictionaryFromParent](ParentDic=code_block_121, ChildDic=code_block_126)

flatten_10 = List.Flatten(list=valueAtKey_51)

# group (continued): 사각 공간 색상 지정
getItemAtIndex_18 = List.GetItemAtIndex(list=flatten_10, index=flatten_9)
valueAtKey_53 = DesignScript.Builtin.Dictionary.ValueAtKey(dictionary=valueAtKey_47, key=getItemAtIndex_18)
byGeometryColor = Modifiers.GeometryColor.ByGeometryColor(geometry=thicken, color=valueAtKey_53)

# group: GD Output - difference area to minimum
code_block_127 = CodeBlock(InputDic=extendsChildDictionaryFromParent_14.dictionary) { _InputDic; }
code_block_128 = CodeBlock { "ShakedSurfaces"; }
code_block_129 = CodeBlock { "BoxZvalue"; }
code_block_130 = CodeBlock { "BldgBoundary"; }
valueAtKey_54 = DesignScript.Builtin.Dictionary.ValueAtKey(dictionary=code_block_127, key=code_block_130)
basePlane = PolyCurve.BasePlane(polyCurve=valueAtKey_54)
firstItem_3 = List.FirstItem(list=basePlane)
code_block_131 = CodeBlock { 1; }
code_block_132 = CodeBlock { 10; }
offset = Curve.Offset(curve=valueAtKey_54, distance=code_block_132)

code_block_133 = CodeBlock { "BoxClass_nonfixedclustered"; }
valueAtKey_55 = DesignScript.Builtin.Dictionary.ValueAtKey(dictionary=code_block_127, key=code_block_133)

# group (continued): GD Output - difference area to minimum
valueAtKey_56 = DesignScript.Builtin.Dictionary.ValueAtKey(dictionary=valueAtKey_55, key=code_block_128)
flatten_11 = List.Flatten(list=valueAtKey_56)
valueAtKey_57 = DesignScript.Builtin.Dictionary.ValueAtKey(dictionary=valueAtKey_55, key=code_block_129)
flatten_12 = List.Flatten(list=valueAtKey_57)
uniqueItems_5 = List.UniqueItems(list=flatten_12)
allIndicesOf_2 = List.AllIndicesOf(list=flatten_12, item=uniqueItems_5)

perimeterCurves = Surface.PerimeterCurves(surface=flatten_11)
byJoinedCurves_2 = PolyCurve.ByJoinedCurves(curves=perimeterCurves)
flatten_13 = List.Flatten(list=allIndicesOf_2)

# group (continued): GD Output - difference area to minimum
getItemAtIndex_19 = List.GetItemAtIndex(list=byJoinedCurves_2, index=flatten_13)
pullOntoPlane = Curve.PullOntoPlane(curve=getItemAtIndex_19, plane=firstItem_3)
byPatch_3 = Surface.ByPatch(closedCurve=pullOntoPlane)
split = Geometry.Split(geometry=byPatch_3, other=valueAtKey_54, lacing=CrossProduct)
flatten_14 = List.Flatten(list=split@L2, amt=code_block_131)
flatten_15 = List.Flatten(list=flatten_14)
doesIntersect_2 = Geometry.DoesIntersect(geometry=flatten_15@L2, other=offset@L1)
flatten_16 = List.Flatten(list=doesIntersect_2)
filterByBoolMask_2 = List.FilterByBoolMask(list=flatten_15, mask=flatten_16)
area = Surface.Area(surface=filterByBoolMask_2.in)
math_sum_outside_area_of = Math.Sum(values=area)  # "Math.Sum@Outside Area of Boundary"; graph output

code_block_134 = CodeBlock { "BoxDepartment"; }
valueAtKey_58 = DesignScript.Builtin.Dictionary.ValueAtKey(dictionary=valueAtKey_48, key=code_block_134)
watch_6 = Watch(valueAtKey_58)
code_block_135 = CodeBlock(i=shakeRoomSurfaces) { i[6]; }
python_script = Python(IN[0]=code_block_135, IN[1]=byOrigin, IN[2]=maximumItem_3, IN[3]=minimumItem)  # IronPython2
# ---------- python_script.python (370 lines) ----------
# Python 표준 및 DesignScript 라이브러리 로드
from random import randint
import sys
import clr
clr.AddReference('ProtoGeometry')
clr.AddReference('DSCoreNodes')
from DSCore import *
from Autodesk.DesignScript.Geometry import *



def GetXOrderSurfaces(sl):
    ls = []
    for s in sl:
        ls.append(SortByMinX(s))

    ls.sort()

    r = []
    for l in ls:
        r.append(l.val)

    return r

def GetYOrderSurfaces(sl):
    ls = []
    for s in sl:
        ls.append(SortByMinY(s))

    ls.sort()

    r = []
    for l in ls:
        r.append(l.val)

    return r

def GetIndexOfSurface(s, sl):
    for i in range(0, len(sl)):
        if sl[i] == s:
            return i

def GetSurfaceMinX(s):
    a1 = Math.Min(s.PointAtParameter(0,0).X, s.PointAtParameter(0,1).X)
    a2 = Math.Min(s.PointAtParameter(1,0).X, s.PointAtParameter(1,1).X)
    return Math.Min(a1, a2)

def GetSurfaceMaxX(s):
    a1 = Math.Max(s.PointAtParameter(0,0).X, s.PointAtParameter(0,1).X)
    a2 = Math.Max(s.PointAtParameter(1,0).X, s.PointAtParameter(1,1).X)
    return Math.Max(a1, a2)

def GetSurfaceMinY(s):
    a1 = Math.Min(s.PointAtParameter(0,0).Y, s.PointAtParameter(0,1).Y)
    a2 = Math.Min(s.PointAtParameter(1,0).Y, s.PointAtParameter(1,1).Y)
    return Math.Min(a1, a2)

def GetSurfaceMaxY(s):
    a1 = Math.Max(s.PointAtParameter(0,0).Y, s.PointAtParameter(0,1).Y)
    a2 = Math.Max(s.PointAtParameter(1,0).Y, s.PointAtParameter(1,1).Y)
    return Math.Max(a1, a2)


class SortByMinX(object):
     def __init__(self, val):
         self.val = val

     def __lt__(self, other):
         return GetSurfaceMinX(self.val) < GetSurfaceMinX(other.val)

class SortByMinY(object):
     def __init__(self, val):
         self.val = val

     def __lt__(self, other):
         return GetSurfaceMinY(self.val) < GetSurfaceMinY(other.val)


def CreateXCheckerSurface(s):
    minX = GetSurfaceMinX(s)
    minY = GetSurfaceMinY(s)
    maxX = GetSurfaceMaxX(s)
    maxY = GetSurfaceMaxY(s)
    minZ = s.PointAtParameter(0,0).Z
    pl = [
            Point.ByCoordinates(minX - 100000, minY + 0.1, minZ),
            Point.ByCoordinates(minX - 100000, maxY - 0.1, minZ),
            Point.ByCoordinates(minX, maxY - 0.1, minZ),
            Point.ByCoordinates(minX, minY + 0.1, minZ),
        ]

    checkerX = Surface.ByPerimeterPoints(pl)

    return checkerX

def CreateYCheckerSurface(s):
    minX = GetSurfaceMinX(s)
    minY = GetSurfaceMinY(s)
    maxX = GetSurfaceMaxX(s)
    maxY = GetSurfaceMaxY(s)
    minZ = s.PointAtParameter(0,0).Z
    pl = [
            Point.ByCoordinates(minX + 0.1, minY - 100000, minZ),
            Point.ByCoordinates(minX + 0.1, minY, minZ),
            Point.ByCoordinates(maxX - 0.1, minY, minZ),
            Point.ByCoordinates(maxX - 0.1, minY - 100000, minZ),
        ]

    checkerX = Surface.ByPerimeterPoints(pl)

    return checkerX

def GetDistanceXToMove(s, sl):
    checkerX = CreateXCheckerSurface(s)

    cl = []

    noHit = True

    for si in sl:
        if si == s:
            continue
        else:
            if checkerX.DoesIntersect(si) == True:
                noHit = False

                cl.append(si.PointAtParameter(0,0).X)
                cl.append(si.PointAtParameter(0,1).X)
                cl.append(si.PointAtParameter(1,0).X)
                cl.append(si.PointAtParameter(1,1).X)

    if noHit == True:
        return - GetSurfaceMinX(s)
    else:
        cl.sort(reverse=True)
        return cl[0] - GetSurfaceMinX(s)

def GetDistanceYToMove(s, sl):
    checkerY = CreateYCheckerSurface(s)

    cl = []

    noHit = True

    for si in sl:
        if si == s:
            continue
        else:
            if checkerY.DoesIntersect(si) == True:
                noHit = False

                cl.append(si.PointAtParameter(0,0).Y)
                cl.append(si.PointAtParameter(0,1).Y)
                cl.append(si.PointAtParameter(1,0).Y)
                cl.append(si.PointAtParameter(1,1).Y)

    if noHit == True:
        return - GetSurfaceMinY(s)
    else:
        cl.sort(reverse=True)
        return cl[0] - GetSurfaceMinY(s)


def MoveX():
    xOrdered = GetXOrderSurfaces(surfacelist)

    for s in xOrdered:    
        toMoveX = GetDistanceXToMove(s, surfacelist)
        idx = GetIndexOfSurface(s, surfacelist)
        surfacelist[idx] = Geometry.Translate(surfacelist[idx], toMoveX, 0, 0)

def MoveY():
    yOrdered = GetYOrderSurfaces(surfacelist)

    for s in yOrdered:
        toMoveY = GetDistanceYToMove(s, surfacelist)
        idx = GetIndexOfSurface(s, surfacelist)
        surfacelist[idx] = Geometry.Translate(surfacelist[idx], 0, toMoveY, 0)

def SplitX():
    xOrdered = GetXOrderSurfaces(surfacelist)

    offsetX = 0   
    for i in range(0, len(xOrdered)):
        idx = GetIndexOfSurface(xOrdered[i], surfacelist)

        mx = offsetX - GetSurfaceMinX(surfacelist[idx])
        surfacelist[idx] = Geometry.Translate(surfacelist[idx], mx, 0, 0)

        sx = GetSurfaceMaxX(surfacelist[idx]) - GetSurfaceMinX(surfacelist[idx])
        offsetX = offsetX + sx

def SplitY():
    yOrdered = GetYOrderSurfaces(surfacelist)

    offsetY = 0   
    for i in range(0, len(yOrdered)):
        idx = GetIndexOfSurface(yOrdered[i], surfacelist)

        my = offsetY - GetSurfaceMinY(surfacelist[idx])
        surfacelist[idx] = Geometry.Translate(surfacelist[idx], 0, my, 0)

        sy = GetSurfaceMaxY(surfacelist[idx]) - GetSurfaceMinY(surfacelist[idx])
        offsetY = offsetY + sy

def MinofAll():
    allX = []
    allY = []
    for s in surfacelist:
        allX.append(GetSurfaceMinX(s))
        allY.append(GetSurfaceMinY(s))
    allX.sort()
    allY.sort()
    x = 0
    if allX[0] < 0:
        x = -allX[0]
    y = 0
    if allY[0] < 0:
        y = -allY[0]

    return x,y

def MaxofAll():
    allX = []
    allY = []
    for s in surfacelist:
        allX.append(GetSurfaceMaxX(s))
        allY.append(GetSurfaceMaxY(s))
    allX.sort(reverse=True)
    allY.sort(reverse=True)

    return (allX[0], allY[0])

def GetRectMinMaxCornerPoint(center, width, length):
    return (Point.ByCoordinates(center.X - width / 2, center.Y - length /2, center.Z), Point.ByCoordinates(center.X + width / 2, center.Y + length /2, center.Z))


def RepositionInRectOutX(center, width, length):
    (minPos, maxPos) = GetRectMinMaxCornerPoint(center, width, length)
    rectX = maxPos.X - minPos.X
    rectY = maxPos.Y - minPos.Y

    for i in range(0, len(surfacelist)):
        if GetSurfaceMaxX(surfacelist[i]) > rectX:
            (allMaxX, allMaxY) = MaxofAll()
            offsetY = allMaxY - GetSurfaceMinY(surfacelist[i])
            surfacelist[i] = Geometry.Translate(surfacelist[i], 0, offsetY, 0)
            MoveX()
            MoveY()

def RepositionInRectInX(center, width, length):
    (minPos, maxPos) = GetRectMinMaxCornerPoint(center, width, length)
    rectX = maxPos.X - minPos.X
    rectY = maxPos.Y - minPos.Y

    for i in range(0, len(surfacelist)):
        if GetSurfaceMaxX(surfacelist[i]) > rectX:
            offsetY = rectY - GetSurfaceMaxY(surfacelist[i])
            surfacelist[i] = Geometry.Translate(surfacelist[i], 0, offsetY, 0)
            MoveX()
            MoveY()

def RepositionInRectOutY(center, width, length):
    (minPos, maxPos) = GetRectMinMaxCornerPoint(center, width, length)
    rectX = maxPos.X - minPos.X
    rectY = maxPos.Y - minPos.Y

    for i in range(0, len(surfacelist)):
        if GetSurfaceMaxY(surfacelist[i]) > rectY:
            (allMaxX, allMaxY) = MaxofAll()
            offsetX = allMaxX - GetSurfaceMinX(surfacelist[i])
            surfacelist[i] = Geometry.Translate(surfacelist[i], offsetX, 0, 0)
            MoveY()
            MoveX()

def RepositionInRectInY(center, width, length):
    (minPos, maxPos) = GetRectMinMaxCornerPoint(center, width, length)
    rectX = maxPos.X - minPos.X
    rectY = maxPos.Y - minPos.Y

    for i in range(0, len(surfacelist)):
        if GetSurfaceMaxY(surfacelist[i]) > rectY:
            offsetX = rectX - GetSurfaceMaxX(surfacelist[i])
            surfacelist[i] = Geometry.Translate(surfacelist[i], offsetX, 0, 0)
            MoveY()
            MoveX()

def MoveAllTo(ox, oy):
    for i in range(0, len(surfacelist)):
        surfacelist[i] = Geometry.Translate(surfacelist[i], ox, oy, 0)

def CheckOutOfBoundary(center, width, length):
    result = []
    (minPos, maxPos) = GetRectMinMaxCornerPoint(center, width, length)
    rectX = maxPos.X - minPos.X
    rectY = maxPos.Y - minPos.Y

    for i in range(0, len(surfacelist)):
        if GetSurfaceMaxX(surfacelist[i]) > rectX or GetSurfaceMaxY(surfacelist[i]) > rectY:
            result.append(i)
    return result



#def FindBoundaryPoint(crv):
#    x = crv.PointAtParameter(0).X
#    y = crv.PointAtParameter(0).Y
#    
#    return x,y


# 이 노드에 대한 입력값은 IN 변수에 리스트로 저장됩니다.
dataEnteringNode = IN

# 코드를 이 선 아래에 배치

surfaces = IN[0]
cs = IN[1]
width = IN[2]
length = IN[3]
#bdCrv = IN[1]

(boundryMin, boundryMax) = GetRectMinMaxCornerPoint(cs[0].Origin, width[0], length[0])

surfacelist = []
for s in surfaces:
    surfacelist.append(s)

(basX, basY) = MinofAll()
#(basX, basY) = FindBoundaryPoint(bdCrv)
#(basX, basY) = 0, 0

for i in range(0, len(surfacelist)):
    surfacelist[i] = Geometry.Translate(surfacelist[i], basX, basY, 0)

if randint(0, 1) == 0:
    SplitX()
    MoveX()
    MoveY()
    MoveX()
    MoveY()

else:
    SplitY()
    MoveY()
    MoveX()
    MoveY()
    MoveX()

RepositionInRectOutX(cs[0].Origin, width[0], length[0])
RepositionInRectOutY(cs[0].Origin, width[0], length[0])
RepositionInRectInX(cs[0].Origin, width[0], length[0])
RepositionInRectInY(cs[0].Origin, width[0], length[0])

failed = CheckOutOfBoundary(cs[0].Origin, width[0], length[0])

MoveAllTo(boundryMin.X, boundryMin.Y)

# testnum = IN[1]
# xOrdered = GetXOrderSurfaces(surfacelist)

# # for s in xOrdered:    
# toMoveX = GetDistanceXToMove(xOrdered[testnum], surfacelist)
# idx = GetIndexOfSurface(xOrdered[testnum], surfacelist)
# surfacelist[idx] = Geometry.Translate(surfacelist[idx], toMoveX, 0, 0)



# 출력을 OUT 변수에 지정합니다.
OUT = surfacelist#(surfacelist, failed)
# ----------------------------------------
python_script_2 = Python(IN[0]=code_block_135, IN[1]=byOrigin, IN[2]=maximumItem_3, IN[3]=minimumItem)  # IronPython2; same code as python_script
python_script_3 = Python(IN[0]=shakeRoomSurfaces, IN[1]=watch_4)  # CPython3
# ---------- python_script_3.python (138 lines) ----------
# Load the Python Standard and DesignScript Libraries
from random import randint
import sys
import clr
clr.AddReference('ProtoGeometry')
from Autodesk.DesignScript.Geometry import *
clr.AddReference('DSCoreNodes')
from DSCore import *
from functools import reduce

# The inputs to this node will be stored as a list in the IN variables.
##############################
dataEnteringNode = IN
InList = IN[0]
PlacingBoundary = IN[1]

PrePlacingList = []
PostPlacingList = []
##----------------------For ConvexHull----------------------------------
##----------------------------------------------------------------------
def ToVals(pt):
	return [pt.X,pt.Y,pt.Z]

def ToPts(ptVals):
	return Point.ByCoordinates(ptVals[0],ptVals[1],ptVals[2])

def CreateOutline(pts):
	crvs = []
	i = 0
	while i < len(pts):
		if i == len(pts)-1:
			crvs.append(Line.ByStartPointEndPoint(pts[i],pts[0]))
		else:
			crvs.append(Line.ByStartPointEndPoint(pts[i],pts[i+1]))
		i = i+1
	return PolyCurve.ByJoinedCurves(crvs)
	
def convex_hull_graham(points):
	
	TURN_LEFT, TURN_RIGHT, TURN_NONE = (1, -1, 0)

	def cmp(a, b):
		return (a > b) - (a < b)
	
	def turn(p, q, r):
		return cmp((q[0] - p[0])*(r[1] - p[1]) - (r[0] - p[0])*(q[1] - p[1]), 0)
	
	def _keep_left(hull, r):
		while len(hull) > 1 and turn(hull[-2], hull[-1], r) != TURN_LEFT:
			hull.pop()
		if not len(hull) or hull[-1] != r:
			hull.append(r)
		return hull

	points = [ToVals(p) for p in points]	
	points = sorted(points)
	l = reduce(_keep_left, points, [])
	u = reduce(_keep_left, reversed(points), [])
	points = l.extend(u[i] for i in range(1, len(u) - 1)) or l
	points = [ToPts(p) for p in points]
	return CreateOutline(points)
##----------------------------------------------------------------------
##----------------------------------------------------------------------

#def SetMovingPoint(cluster):
#    a = ClusterComplex(cluster)
#    a.

class NestedListHandler:
    def __init__(self, inList):
        self.inList = inList
        outList = []
        for li in inList:
            sublist = []
            for i in li:
                sublist.append(i)
            outList.append(sublist)
            sublist = []
        self.OutList = outList

class ClusterComplex:
    def __init__(self, clusterSet):
        self.clusterSet = clusterSet
        
        JoinedSrf= PolySurface.ByJoinedSurfaces(clusterSet)
        self.JoinedSrf = JoinedSrf
        
        perimeter = JoinedSrf.PerimeterCurves()
        _points = []
        
        for i in perimeter: ## 페리미터 커브들의 시작점 추출
            tmp = i.StartPoint
            _points.append(tmp)
            
        convex_crv = convex_hull_graham(_points) # 클러스터 포인트들의 볼록껍질 커브
        self.convex_crv = convex_crv
        off_convex_crv = Curve.Offset(convex_crv,-10) # 볼록껍질의 내부 측 오프셋 커브
        self.off_convex_crv = off_convex_crv
        off_convex_srf = Surface.ByPatch(off_convex_crv)
        
        convex_bdry_srf = Surface.ByLoft([Curve.Offset(convex_crv,10), off_convex_crv])
        convex_bdry_solid = Surface.Thicken(convex_bdry_srf, 1, True)
        
        differed_srf = Surface.Difference(off_convex_srf, clusterSet)
        self.differed_srf = differed_srf
        
        div_differed_srflist = PolySurface.Surfaces(differed_srf)
        self.div_differed_srflist = div_differed_srflist
        outer_srflist = []

        for i in div_differed_srflist:
            if Geometry.Intersect(convex_bdry_solid, i):
                outer_srflist.append(i)

        self.outer_srflist = outer_srflist
        crvForIP = PolySurface.ByJoinedSurfaces(outer_srflist).PerimeterCurves()
        self.crvForIP = crvForIP
        
        IPlist = []
        NIPlist = []
        for i in crvForIP:
            tmp = i.StartPoint
            if not Geometry.DoesIntersect(convex_bdry_solid, tmp):
                IPlist.append(tmp)
            else:
                NIPlist.append(tmp)
        
        self.IPlist = IPlist
        self.NIPlist = NIPlist
        
		
# Place your code below this line
nestedlist = NestedListHandler(InList).OutList
c = ClusterComplex(InList[6])


# Assign your output to the OUT variable.
OUT = (c.off_convex_crv, c.IPlist, c.NIPlist, c.outer_srflist)
# ----------------------------------------
code_block_136 = CodeBlock(i=python_script_3) { i[0]; i[1][2]; }
byJoinedCurves_3 = PolyCurve.ByJoinedCurves(curves=code_block_136.out0)
doesIntersect_3 = Geometry.DoesIntersect(geometry=code_block_136.out0, other=code_block_136.out1)
intersect = Geometry.Intersect(geometry=code_block_136.out0, other=code_block_136.out1)
watch_7 = Watch(code_block_136.out0)
code_block_137 = CodeBlock(i=python_script_3) { i[3]; }
code_block_138 = CodeBlock(i=python_script_3) { i[1]; }
code_block_139 = CodeBlock(i=python_script_3) { i[2]; }
code_block_140 = CodeBlock { 10000; 20000; }
byWidthLength_2 = Rectangle.ByWidthLength(width=code_block_140.out0, length=code_block_140.out1)
byPatch_4 = Surface.ByPatch(closedCurve=byWidthLength_2)
# note: i[6]
code_block_141 = CodeBlock(i=chop) { i[3]; i[6]; i; }
perimeterCurves_2 = Surface.PerimeterCurves(surface=code_block_141.out0)
startPoint_2 = Curve.StartPoint(curve=perimeterCurves_2)
flatten_17 = List.Flatten(list=startPoint_2)
# note: whole cluster
code_block_142 = CodeBlock(i=shakeRoomSurfaces) { i; }
python_script_20210908 = Python(IN[0]=code_block_142, IN[1]=watch_4)  # CPython3; frozen
# ---------- python_script_20210908.python (147 lines) ----------
# Load the Python Standard and DesignScript Libraries
from random import randint
import sys
import clr
clr.AddReference('ProtoGeometry')
from Autodesk.DesignScript.Geometry import *
clr.AddReference('DSCoreNodes')
from DSCore import *
from DSCore import Color
clr.AddReference('GeometryColor')
from Modifiers import GeometryColor
from functools import reduce

# The inputs to this node will be stored as a list in the IN variables.
##############################
dataEnteringNode = IN
InList = IN[0]
PlacingBoundary = IN[1]

PrePlacingList = []
PostPlacingList = []

###########################################################################
class FuncCurrying:
    pass

class ConvexHull_Maker:
    def __init__(self, points):
        def convex_hull_graham(points):
            def ToVals(pt):
	            return [pt.X,pt.Y,pt.Z]
            def ToPts(ptVals):
	            return Point.ByCoordinates(ptVals[0],ptVals[1],ptVals[2])
	           
            def CreateOutline(pts):
                crvs = []
                i = 0
                while i < len(pts):
                    if i == len(pts)-1:
                        crvs.append(Line.ByStartPointEndPoint(pts[i],pts[0]))
                    else:
                        crvs.append(Line.ByStartPointEndPoint(pts[i],pts[i+1]))
                    i = i+1
                return PolyCurve.ByJoinedCurves(crvs)
	
            TURN_LEFT, TURN_RIGHT, TURN_NONE = (1, -1, 0)

            def cmp(a, b):
                return (a > b) - (a < b)
	
            def turn(p, q, r):
                return cmp((q[0] - p[0])*(r[1] - p[1]) - (r[0] - p[0])*(q[1] - p[1]), 0)
	
            def _keep_left(hull, r):
                while len(hull) > 1 and turn(hull[-2], hull[-1], r) != TURN_LEFT:
                    hull.pop()
                if not len(hull) or hull[-1] != r:
                    hull.append(r)
                return hull

            points = [ToVals(p) for p in points]	
            points = sorted(points)
            l = reduce(_keep_left, points, [])
            u = reduce(_keep_left, reversed(points), [])
            points = l.extend(u[i] for i in range(1, len(u) - 1)) or l
            points = [ToPts(p) for p in points]
            return CreateOutline(points)
            
        self.points = points
        result = convex_hull_graham(points)
        self.result = result

class ClusterComplex: ## clst: cluster set, cl: cluster, clem: cluster elements
    def __init__(self, clst):
        self.clst = clst
        
        def create_JoinedSrfBy_clst(clst):
            return PolySurface.ByJoinedSurfaces(clst)
        
        def find_PerimeterCrvsOn_srf(srf):
            return srf.PerimeterCurves()
            
        def get_PointOf_PerimeterCrvs(crvs):
            _points = []
            for i in crvs:
                _points.append(i.StartPoint)
            return _points
            
        def get_ConvexHullFor_cl(cl):
            return ConvexHull_Maker(cl).result
            
        def patch_ConvexHull_cl(cl):
            pass
            
        def create_offsetcrv(crv, offset):
            return Curve.Offset(crv, offset)
            
        def create_bdrysolid_forInsp(crv):
            offin_convex_crv = Curve.Offset(crv,-10)
            offout_convex_crv = Curve.Offset(crv,300)
            convex_bdry_srf = Surface.ByLoft([offout_convex_crv, offin_convex_crv])
            convex_bdry_solid = Surface.Thicken(convex_bdry_srf, 1, True)
            return convex_bdry_solid
            
        def find_boundary_point(cl):
            
            pass
        #---------------------------------------------
        
        srf = []
        for i in clst:
            srf.append(create_JoinedSrfBy_clst(i))
        self.srf = srf
            
        crvs = []
        for i in srf:
            crvs.append(find_PerimeterCrvsOn_srf(i))
            
        startpt_crv = []
        for i in crvs:
            startpt_crv.append(get_PointOf_PerimeterCrvs(i))
        self.startpt_crv = startpt_crv
        
        crv_convexhull_clst = []
        for i in startpt_crv:
            crv_convexhull_clst.append(get_ConvexHullFor_cl(i))
        self.crv_convexhull_clst = crv_convexhull_clst
        
        bdrysolid_convexhull_clst = []
        for i in crv_convexhull_clst:
            bdrysolid_convexhull_clst.append(create_bdrysolid_forInsp(i))
        self.bdrysolid_convexhull_clst = bdrysolid_convexhull_clst

# Place your code below this line
def f_vision(i):
	return GeometryColor.ByGeometryColor(i, Color.ByARGB(125, 255, 0, 0))
#d = f_vision(ClusterComplex(InList).bdrysolid_convexhull_clst[6])
e = ClusterComplex(InList).bdrysolid_convexhull_clst[6]
a = ClusterComplex(InList).srf
b = ClusterComplex(InList).startpt_crv
c = ClusterComplex(InList).crv_convexhull_clst
#d = []
#for i in ClusterComplex(InList).bdrysolid_convexhull_clst:
#    d.append(GeometryColor.ByGeometryColor(i, Color.ByARGB(125, 255, 0, 0)))
d = list(map(f_vision,ClusterComplex(InList).bdrysolid_convexhull_clst))
# Assign your output to the OUT variable.
OUT = (a,b,c,d)
# ----------------------------------------
watch_8 = Watch(shakeRoomSurfaces)
code_block_143 = CodeBlock(PlacingBoundary=watch_4) { PlacingBoundary; }
python_script_20210915 = Python(IN[0]=code_block_141.i, IN[1]=code_block_143)  # CPython3; frozen
# ---------- python_script_20210915.python (260 lines) ----------
# Load the Python Standard and DesignScript Libraries
from random import randint
import sys
import clr
clr.AddReference('ProtoGeometry')
from Autodesk.DesignScript.Geometry import *
clr.AddReference('DSCoreNodes')
from DSCore import *
from DSCore import Color
clr.AddReference('GeometryColor')
from Modifiers import GeometryColor
from functools import reduce
import itertools
import operator


# The inputs to this node will be stored as a list in the IN variables.
##############################
dataEnteringNode = IN
InList = IN[0]
PlacingBoundary = IN[1]
pBdry_crvs = PolyCurve.Curves(PlacingBoundary[0])
pBdry_pts = list(map(lambda x: x.StartPoint,pBdry_crvs))
PrePlacingList = []
PostPlacingList = []

###########################################################################

class ConvexHull_Maker:
    def __init__(self, points):
        def convex_hull_graham(points):
            def ToVals(pt):
	            return [pt.X,pt.Y,pt.Z]
            def ToPts(ptVals):
	            return Point.ByCoordinates(ptVals[0],ptVals[1],ptVals[2])
	           
            def CreateOutline(pts):
                crvs = []
                i = 0
                while i < len(pts):
                    if i == len(pts)-1:
                        crvs.append(Line.ByStartPointEndPoint(pts[i],pts[0]))
                    else:
                        crvs.append(Line.ByStartPointEndPoint(pts[i],pts[i+1]))
                    i = i+1
                return PolyCurve.ByJoinedCurves(crvs)
	
            TURN_LEFT, TURN_RIGHT, TURN_NONE = (1, -1, 0)

            def cmp(a, b):
                return (a > b) - (a < b)
	
            def turn(p, q, r):
                return cmp((q[0] - p[0])*(r[1] - p[1]) - (r[0] - p[0])*(q[1] - p[1]), 0)
	
            def _keep_left(hull, r):
                while len(hull) > 1 and turn(hull[-2], hull[-1], r) != TURN_LEFT:
                    hull.pop()
                if not len(hull) or hull[-1] != r:
                    hull.append(r)
                return hull

            points = [ToVals(p) for p in points]	
            points = sorted(points)
            l = reduce(_keep_left, points, [])
            u = reduce(_keep_left, reversed(points), [])
            points = l.extend(u[i] for i in range(1, len(u) - 1)) or l
            points = [ToPts(p) for p in points]
            return CreateOutline(points)
            
        self.points = points
        result = convex_hull_graham(points)
        self.result = result

class Qluster:
    def __init__(self, cl):
        def create_joinedSrf(cl):
            return PolySurface.ByJoinedSurfaces(cl)
        def find_periCrvsOn_srf(srf):
            return srf.PerimeterCurves()
        def get_PointOf_PeriCrvs(crvs):
            return list(map(lambda x: x.StartPoint,crvs))
        def get_cvxHullFor_cl(cl):
            return ConvexHull_Maker(cl).result
        def create_offsetCrv(crv, offset):
            return Curve.Offset(crv, offset)
        def create_bdrySolid_forInsp(pcrv):
            offin_cvx_crv = Curve.Offset(pcrv,-10)
            offout_cvx_crv = Curve.Offset(pcrv,300)
            cvx_bdry_srf = Surface.ByLoft([offout_cvx_crv, offin_cvx_crv])
            cvx_bdry_solid = Surface.Thicken(cvx_bdry_srf, 1, True)
            return cvx_bdry_solid
        def patch_pCrv(pcrv):
            return Surface.ByPatch(pcrv)
        def find_boundary_point(cl):
            pass
            
        self.cl = cl
        
        psrf = create_joinedSrf(cl)
        self.psrf = psrf
        
        level_cl = BoundingBox.ByGeometry(psrf).MaxPoint.Z
        self.level_cl = level_cl
        
        crvs = find_periCrvsOn_srf(psrf)
        self.crvs = crvs
        
        startpt_crv = get_PointOf_PeriCrvs(crvs)
        self.startpt_crv = startpt_crv
        
        crv_cvxHull = get_cvxHullFor_cl(startpt_crv)
        self.crv_cvxHull = crv_cvxHull
        
        crv_cvxHull_offin = create_offsetCrv(crv_cvxHull, -10)
        bdrysolid_cvxHull = create_bdrySolid_forInsp(crv_cvxHull)
        self.bdrysolid_cvxHull = bdrysolid_cvxHull
        
        patched_cvxHull = patch_pCrv(crv_cvxHull)

        try:
            diff_srf = Surface.Difference(patched_cvxHull, cl)
            if isinstance(diff_srf, PolySurface):
                div_diff_srflist = PolySurface.Surfaces(diff_srf)
            else:
                div_diff_srflist = [diff_srf]
        except:
            div_diff_srflist = [patched_cvxHull]
        self.div_diff_srflist = div_diff_srflist
        
        outer_srf_diff = list(
        filter(lambda x: Geometry.DoesIntersect(x, bdrysolid_cvxHull), div_diff_srflist))
        self.outer_srf_diff = outer_srf_diff
        inner_srf_diff = list(
        filter(lambda x: Geometry.DoesIntersect(x, bdrysolid_cvxHull) == False, div_diff_srflist))
        if len(inner_srf_diff) == 0:
            pt_cl_bdry = startpt_crv
        else:
            joined_inner_srf = PolySurface.ByJoinedSurfaces(inner_srf_diff)
            pre_pt_cl_bdry = list(
            filter(lambda x: Geometry.DoesIntersect(x, joined_inner_srf) == False, startpt_crv))
            pt_cl_bdry = list(
            filter(lambda x: Geometry.DoesIntersect(x, patch_pCrv(crv_cvxHull_offin)) == False, pre_pt_cl_bdry))
        crvlist_outer_srf = list(map(find_periCrvsOn_srf, outer_srf_diff))
        pt_outer_srf = sum(list(map(get_PointOf_PeriCrvs, crvlist_outer_srf)),[])
        self.pt_outer_srf = pt_outer_srf
        pt_cvx_bdry = list(filter(lambda x: Geometry.DoesIntersect(x, bdrysolid_cvxHull), pt_outer_srf))
 
        preip = list(filter(lambda x: Geometry.DoesIntersect(x, bdrysolid_cvxHull) != True, pt_outer_srf))
        
        def f_nip(x):
            return filter(lambda y: Geometry.DoesIntersect(x, y) == False, cir_ip)

        if len(preip) == 0:
            minX = min(map(lambda x: round(x.X,3), pt_outer_srf))
            maxY = max(map(lambda x: round(x.Y,3), pt_outer_srf))
            pt_X = list(filter(lambda x: round(x.X,3) == minX, pt_outer_srf))
            ip = list(filter(lambda x: round(x.Y,3) == maxY, pt_X))
            cir_ip = list(map(lambda x: Sphere.ByCenterPointRadius(x,1), ip))
            uni_cir_ip = Solid.ByUnion(cir_ip)
            nip = list(filter(lambda x: Geometry.DoesIntersect(x, uni_cir_ip) == False, pt_cl_bdry))
        else:
            ip = list(filter(lambda x: Geometry.DoesIntersect(x, bdrysolid_cvxHull) != True, pt_outer_srf))
            cir_ip = list(map(lambda x: Sphere.ByCenterPointRadius(x,1), ip))
            uni_cir_ip = Solid.ByUnion(cir_ip)
            nip = list(filter(lambda x: Geometry.DoesIntersect(x, uni_cir_ip) == False, pt_cl_bdry))
        self.cir_ip = cir_ip
        self.ip = ip
        self.nip = nip
        qcircle_ip = list(map(lambda x: Sphere.ByCenterPointRadius(x,500), ip))
        self.qcircle_ip = qcircle_ip
        qcircle_nip = list(map(lambda x: Sphere.ByCenterPointRadius(x,500), nip))
        self.qcircle_nip = qcircle_nip
        
    def translate(self, vec):
        return list(map(lambda x: Geometry.Translate(x, vec), self.cl))

### 층별로 클러스터 set 만드는 클래스? 혹은 기능 구간 삽입 필요###
class QlusterSetByLevel:
    def __init__(self, cl):
        data = list(map(lambda x: {'obj': Qluster(x), 'level': str(Qluster(x).level_cl)}, cl))
        grouped_data = itertools.groupby(data, key=operator.itemgetter('level'))
        self.grouped_data = grouped_data
        tmp = {}
        for key, i in grouped_data:
            tmp[key] = list(i)
        keys = list(tmp.keys())
        self.keys = keys
        result = list(map(lambda x: tmp.get(x), keys))
        self.result = result
        Qresult = list(
            map(lambda x: list(
                map(lambda i: i.get('obj'),x)), result))
        self.Qresult = Qresult
    pass

class QsetPlacer: ## clst: cluster set, cl: cluster, clem: cluster elements
    def __init__(self, qset, pBdry):
        ql_obj = list(map(lambda x: x, qset))#i
        self.ql_obj = ql_obj
        pBdry_crvs = PolyCurve.Curves(pBdry[0])
        pBdry_pts = list(map(lambda x: x.StartPoint,pBdry_crvs))
        
        cl = list(map(lambda x: x.cl, ql_obj))
        self.cl = cl
        qcircle_ip = list(map(lambda x: x.qcircle_ip, ql_obj))
        self.qcircle_ip = qcircle_ip
        level_cl = list(map(lambda x: x.level_cl, ql_obj))
        self.level_cl = level_cl
        
        def place_init(i):
            pass
    
        def place_next(i):
            pass
        
        obj_placed = place_next(ql_obj)



# Place your code below this line
def colorize(i,r,g,b):
	return GeometryColor.ByGeometryColor(i, Color.ByARGB(125, r, g, b))
def place_initial(i):
    c = i[0]
    return c

st_Point = Point.ByCoordinates(0,0,0)
end_Point = Point.ByCoordinates(3000,3000,0)
vec1 = Vector.ByTwoPoints(st_Point,end_Point)
qset = QlusterSetByLevel(InList).Qresult[2]
QSobj = QsetPlacer(qset, PlacingBoundary)
#prime_initPlaced = list(map(lambda x: x.place_initQ(), prime))

#a = Qluster(InList).cl
#b = Qluster(InList).crvs
#c = Qluster(InList).startpt_crv
#d = Qluster(InList).crv_cvxHull
#e = colorize(Qluster(InList).bdrysolid_cvxHull, 255,0,0)
#f = list(map(lambda x: colorize(x,0,125,0),Qluster(InList).qcircle_ip))
#g = Qluster(InList).pt_outer_srf
#h = Qluster(InList).ip
#i = list(map(lambda x: colorize(x,0,0,125),Qluster(InList).qcircle_nip))
#j = Qluster(InList).translate(vec1)
k = QSobj.cl
l = QSobj.qcircle_ip
m = QSobj.ql_obj
n = QSobj.level_cl
o = QlusterSetByLevel(InList).result
p = QlusterSetByLevel(InList).Qresult
#b = Qluster(InList).startpt_crv
#c = Qluster(InList).crv_convexhull_clst
#d = []
#for i in ClusterComplex(InList).bdrysolid_convexhull_clst:
#    d.append(GeometryColor.ByGeometryColor(i, Color.ByARGB(125, 255, 0, 0)))
#d = list(map(lambda i: f_vision(i,255,0,0), Qluster(InList).bdrysolid_convexhull_clst))
#f = ClusterComplex(InList).crvs
#f = list(map(lambda i: f_vision(i,125,0,0),ClusterComplex(InList).bdrysolid_peri_clst))
# Assign your output to the OUT variable.
OUT = (k,l,m,n,o,p)#(b,d,e,f,h,i,j,k)
# ----------------------------------------
byGeometry_2 = BoundingBox.ByGeometry(geom=code_block_141.out1)
ZAxis_4 = Vector.ZAxis()
python_script_20210917 = Python(IN[0]=code_block_141.i, IN[1]=code_block_143)  # CPython3; frozen
# ---------- python_script_20210917.python (280 lines) ----------
# Load the Python Standard and DesignScript Libraries
from random import randint
import sys
import clr
clr.AddReference('ProtoGeometry')
from Autodesk.DesignScript.Geometry import *
clr.AddReference('DSCoreNodes')
from DSCore import *
from DSCore import Color
clr.AddReference('GeometryColor')
from Modifiers import GeometryColor
from functools import reduce
import itertools
import operator


# The inputs to this node will be stored as a list in the IN variables.
##############################
dataEnteringNode = IN
InList = IN[0]
PlacingBoundary = IN[1]
pBdry_crvs = PolyCurve.Curves(PlacingBoundary[0])
pBdry_pts = list(map(lambda x: x.StartPoint,pBdry_crvs))
PrePlacingList = []
PostPlacingList = []

###########################################################################

class ConvexHull_Maker:
    def __init__(self, points):
        def convex_hull_graham(points):
            def ToVals(pt):
	            return [pt.X,pt.Y,pt.Z]
            def ToPts(ptVals):
	            return Point.ByCoordinates(ptVals[0],ptVals[1],ptVals[2])
	           
            def CreateOutline(pts):
                crvs = []
                i = 0
                while i < len(pts):
                    if i == len(pts)-1:
                        crvs.append(Line.ByStartPointEndPoint(pts[i],pts[0]))
                    else:
                        crvs.append(Line.ByStartPointEndPoint(pts[i],pts[i+1]))
                    i = i+1
                return PolyCurve.ByJoinedCurves(crvs)
	
            TURN_LEFT, TURN_RIGHT, TURN_NONE = (1, -1, 0)

            def cmp(a, b):
                return (a > b) - (a < b)
	
            def turn(p, q, r):
                return cmp((q[0] - p[0])*(r[1] - p[1]) - (r[0] - p[0])*(q[1] - p[1]), 0)
	
            def _keep_left(hull, r):
                while len(hull) > 1 and turn(hull[-2], hull[-1], r) != TURN_LEFT:
                    hull.pop()
                if not len(hull) or hull[-1] != r:
                    hull.append(r)
                return hull

            points = [ToVals(p) for p in points]	
            points = sorted(points)
            l = reduce(_keep_left, points, [])
            u = reduce(_keep_left, reversed(points), [])
            points = l.extend(u[i] for i in range(1, len(u) - 1)) or l
            points = [ToPts(p) for p in points]
            return CreateOutline(points)
            
        self.points = points
        result = convex_hull_graham(points)
        self.result = result

class Qluster:
    def __init__(self, cl):
        def create_joinedSrf(cl):
            return PolySurface.ByJoinedSurfaces(cl)
        def find_periCrvsOn_srf(srf):
            return srf.PerimeterCurves()
        def get_PointOf_PeriCrvs(crvs):
            return list(map(lambda x: x.StartPoint,crvs))
        def get_cvxHullFor_cl(cl):
            return ConvexHull_Maker(cl).result
        def create_offsetCrv(crv, offset):
            return Curve.Offset(crv, offset)
        def create_bdrySolid_forInsp(pcrv):
            offin_cvx_crv = Curve.Offset(pcrv,-10)
            offout_cvx_crv = Curve.Offset(pcrv,300)
            cvx_bdry_srf = Surface.ByLoft([offout_cvx_crv, offin_cvx_crv])
            cvx_bdry_solid = Surface.Thicken(cvx_bdry_srf, 1, True)
            return cvx_bdry_solid
        def patch_pCrv(pcrv):
            return Surface.ByPatch(pcrv)
        def find_boundary_point(cl):
            pass
            
        self.cl = cl
        
        psrf = create_joinedSrf(cl)
        self.psrf = psrf
        
        level_cl = BoundingBox.ByGeometry(psrf).MaxPoint.Z
        self.level_cl = level_cl
        
        crvs = find_periCrvsOn_srf(psrf)
        self.crvs = crvs
        
        startpt_crv = get_PointOf_PeriCrvs(crvs)
        self.startpt_crv = startpt_crv
        
        crv_cvxHull = get_cvxHullFor_cl(startpt_crv)
        self.crv_cvxHull = crv_cvxHull
        
        crv_cvxHull_offin = create_offsetCrv(crv_cvxHull, -10)
        bdrysolid_cvxHull = create_bdrySolid_forInsp(crv_cvxHull)
        self.bdrysolid_cvxHull = bdrysolid_cvxHull
        
        patched_cvxHull = patch_pCrv(crv_cvxHull)

        try:
            diff_srf = Surface.Difference(patched_cvxHull, cl)
            if isinstance(diff_srf, PolySurface):
                div_diff_srflist = PolySurface.Surfaces(diff_srf)
            else:
                div_diff_srflist = [diff_srf]
        except:
            div_diff_srflist = [patched_cvxHull]
        self.div_diff_srflist = div_diff_srflist
        
        outer_srf_diff = list(
        filter(lambda x: Geometry.DoesIntersect(x, bdrysolid_cvxHull), div_diff_srflist))
        self.outer_srf_diff = outer_srf_diff
        inner_srf_diff = list(
        filter(lambda x: Geometry.DoesIntersect(x, bdrysolid_cvxHull) == False, div_diff_srflist))
        if len(inner_srf_diff) == 0:
            pt_cl_bdry = startpt_crv
        else:
            joined_inner_srf = PolySurface.ByJoinedSurfaces(inner_srf_diff)
            pre_pt_cl_bdry = list(
            filter(lambda x: Geometry.DoesIntersect(x, joined_inner_srf) == False, startpt_crv))
            pt_cl_bdry = list(
            filter(lambda x: Geometry.DoesIntersect(x, patch_pCrv(crv_cvxHull_offin)) == False, pre_pt_cl_bdry))
        crvlist_outer_srf = list(map(find_periCrvsOn_srf, outer_srf_diff))
        pt_outer_srf = sum(list(map(get_PointOf_PeriCrvs, crvlist_outer_srf)),[])
        self.pt_outer_srf = pt_outer_srf
        pt_cvx_bdry = list(filter(lambda x: Geometry.DoesIntersect(x, bdrysolid_cvxHull), pt_outer_srf))
 
        preip = list(filter(lambda x: Geometry.DoesIntersect(x, bdrysolid_cvxHull) != True, pt_outer_srf))
        
        def f_nip(x):
            return filter(lambda y: Geometry.DoesIntersect(x, y) == False, cir_ip)

        if len(preip) == 0:
            minX = min(map(lambda x: round(x.X,3), pt_outer_srf))
            maxY = max(map(lambda x: round(x.Y,3), pt_outer_srf))
            pt_X = list(filter(lambda x: round(x.X,3) == minX, pt_outer_srf))
            ip = list(filter(lambda x: round(x.Y,3) == maxY, pt_X))
            cir_ip = list(map(lambda x: Sphere.ByCenterPointRadius(x,1), ip))
            uni_cir_ip = Solid.ByUnion(cir_ip)
            nip = list(filter(lambda x: Geometry.DoesIntersect(x, uni_cir_ip) == False, pt_cl_bdry))
        else:
            ip = list(filter(lambda x: Geometry.DoesIntersect(x, bdrysolid_cvxHull) != True, pt_outer_srf))
            cir_ip = list(map(lambda x: Sphere.ByCenterPointRadius(x,1), ip))
            uni_cir_ip = Solid.ByUnion(cir_ip)
            nip = list(filter(lambda x: Geometry.DoesIntersect(x, uni_cir_ip) == False, pt_cl_bdry))
        self.cir_ip = cir_ip
        self.ip = ip
        self.nip = nip
        qcircle_ip = list(map(lambda x: Sphere.ByCenterPointRadius(x,500), ip))
        self.qcircle_ip = qcircle_ip
        qcircle_nip = list(map(lambda x: Sphere.ByCenterPointRadius(x,500), nip))
        self.qcircle_nip = qcircle_nip
        
    def translate(self, vec):
        self.cl = Geometry.Translate(self.cl, vec)
        self.psrf = Geometry.Translate(self.psrf, vec)
        self.ip = Geometry.Translate(self.ip, vec)
        self.nip = Geometry.Translate(self.nip, vec)
        
    def create_rotationlist_nip(self, origin):
        degreelist = [0, 90, 180, 270]
        return list(map(lambda x: Geometry.Rotate(self.psrf, origin, Vector.ZAxis(), x), degreelist))

### 층별로 클러스터 set 만드는 클래스? 혹은 기능 구간 삽입 필요###
class QlusterSetByLevel:
    def __init__(self, cl):
        data = list(map(lambda x: {'obj': Qluster(x), 'level': str(Qluster(x).level_cl)}, cl))
        grouped_data = itertools.groupby(data, key=operator.itemgetter('level'))
        self.grouped_data = grouped_data
        tmp = {}
        for key, i in grouped_data:
            tmp[key] = list(i)
        keys = list(tmp.keys())
        self.keys = keys
        result = list(map(lambda x: tmp.get(x), keys))
        self.result = result
        Qresult = list(
            map(lambda x: list(
                map(lambda i: i.get('obj'),x)), result))
        self.Qresult = Qresult
    pass

class QsetPlacer: ## clst: cluster set, cl: cluster, clem: cluster elements
    def __init__(self, qsetlist, pBdry):
        ql_obj = list(map(lambda x: x, qsetlist))#i
        self.ql_obj = ql_obj
        pBdry_crvs = PolyCurve.Curves(pBdry[0])
        pBdry_pts = list(map(lambda x: x.StartPoint,pBdry_crvs))
        
        ql = list(map(lambda x: x.cl, ql_obj))
        self.ql = ql
        level_ql = list(map(lambda x: x.level_cl, ql_obj))
        self.level_ql = level_ql
        ql_ip = list(map(lambda x: x.ip, ql_obj))
        self.ql_ip = ql_ip
        ql_nip = list(map(lambda x: x.nip, ql_obj))
        self.ql_nip = ql_nip
        qcircle_ip = list(map(lambda x: x.qcircle_ip, ql_obj))
        self.qcircle_ip = qcircle_ip
        
        postPlacingList = []
        accIPList = []

        def arrange_accIPList():
            pass
            
        def putElem_PostList():
            pass
            
        def prefare():
            pass
            
        def find_nip(ql_obj):
            
            return list(map(lambda x: x.nip, ql_obj))
            pass
    
        def place_next(i):
            pass
        
        obj_placed = find_nip(ql_obj)
        self.obj_placed = obj_placed
        
        obj_rotated = []
#        x = Point.ByCoordinates(0,0,0)
#        obj_rotated = ql_obj[0].create_rotationlist_nip(x)
        for i in ql_obj:
            tmp_rotated = []
            for x in i.nip:
                rotList = i.create_rotationlist_nip(x)
                tmp_rotated.append(rotList)
            obj_rotated.append(tmp_rotated)
        self.obj_rotated = obj_rotated




# Place your code below this line
def colorize(i,r,g,b):
	return GeometryColor.ByGeometryColor(i, Color.ByARGB(125, r, g, b))
def place_initial(i):
    c = i[0]
    return c

qset = QlusterSetByLevel(InList).Qresult[2]
QS_obj = QsetPlacer(qset, PlacingBoundary)



k = QS_obj.ql
l = QS_obj.qcircle_ip
m = QS_obj.ql_obj
n = QS_obj.obj_rotated
o = QlusterSetByLevel(InList).result
p = QlusterSetByLevel(InList).Qresult
q = QS_obj

# Assign your output to the OUT variable.
OUT = (k,l,m,n,o,p,q)#(b,d,e,f,h,i,j,k)
# ----------------------------------------
code_block_144 = CodeBlock(i=python_script_20210917) { i[3]; }
code_block_145 = CodeBlock(i=code_block_144) { i[1]; }
code_block_146 = CodeBlock(i=code_block_145) { i[0]; }
python_script_20210924 = Python(IN[0]=code_block_141.i, IN[1]=code_block_143)  # CPython3; frozen
# ---------- python_script_20210924.python (321 lines) ----------
# Load the Python Standard and DesignScript Libraries
from random import randint
import sys
import clr
clr.AddReference('ProtoGeometry')
from Autodesk.DesignScript.Geometry import *
clr.AddReference('DSCoreNodes')
from DSCore import *
from DSCore import Color
clr.AddReference('GeometryColor')
from Modifiers import GeometryColor
from functools import reduce
import itertools
import operator


# The inputs to this node will be stored as a list in the IN variables.
##############################
dataEnteringNode = IN
InList = IN[0]
PlacingBoundary = IN[1]
pBdry_crvs = PolyCurve.Curves(PlacingBoundary[0])
pBdry_pts = list(map(lambda x: x.StartPoint,pBdry_crvs))
PrePlacingList = []
PostPlacingList = []

###########################################################################

class ConvexHull_Maker:
    def __init__(self, points):
        def convex_hull_graham(points):
            def ToVals(pt):
	            return [pt.X,pt.Y,pt.Z]
            def ToPts(ptVals):
	            return Point.ByCoordinates(ptVals[0],ptVals[1],ptVals[2])
	           
            def CreateOutline(pts):
                crvs = []
                i = 0
                while i < len(pts):
                    if i == len(pts)-1:
                        crvs.append(Line.ByStartPointEndPoint(pts[i],pts[0]))
                    else:
                        crvs.append(Line.ByStartPointEndPoint(pts[i],pts[i+1]))
                    i = i+1
                return PolyCurve.ByJoinedCurves(crvs)
	
            TURN_LEFT, TURN_RIGHT, TURN_NONE = (1, -1, 0)

            def cmp(a, b):
                return (a > b) - (a < b)
	
            def turn(p, q, r):
                return cmp((q[0] - p[0])*(r[1] - p[1]) - (r[0] - p[0])*(q[1] - p[1]), 0)
	
            def _keep_left(hull, r):
                while len(hull) > 1 and turn(hull[-2], hull[-1], r) != TURN_LEFT:
                    hull.pop()
                if not len(hull) or hull[-1] != r:
                    hull.append(r)
                return hull

            points = [ToVals(p) for p in points]	
            points = sorted(points)
            l = reduce(_keep_left, points, [])
            u = reduce(_keep_left, reversed(points), [])
            points = l.extend(u[i] for i in range(1, len(u) - 1)) or l
            points = [ToPts(p) for p in points]
            return CreateOutline(points)
            
        self.points = points
        result = convex_hull_graham(points)
        self.result = result

class Qluster:
    def __init__(self, cl):
        def create_joinedSrf(cl):
            return PolySurface.ByJoinedSurfaces(cl)
        def find_periCrvsOn_srf(srf):
            return srf.PerimeterCurves()
        def get_PointOf_PeriCrvs(crvs):
            return list(map(lambda x: x.StartPoint,crvs))
        def get_cvxHullFor_cl(cl):
            return ConvexHull_Maker(cl).result
        def create_offsetCrv(crv, offset):
            return Curve.Offset(crv, offset)
        def create_bdrySolid_forInsp(pcrv):
            offin_cvx_crv = Curve.Offset(pcrv,-10)
            offout_cvx_crv = Curve.Offset(pcrv,300)
            cvx_bdry_srf = Surface.ByLoft([offout_cvx_crv, offin_cvx_crv])
            cvx_bdry_solid = Surface.Thicken(cvx_bdry_srf, 1, True)
            return cvx_bdry_solid
        def patch_pCrv(pcrv):
            return Surface.ByPatch(pcrv)
        def find_boundary_point(cl):
            pass
            
        self.cl = cl
        
        psrf = create_joinedSrf(cl)
        self.psrf = psrf
        
        level_cl = BoundingBox.ByGeometry(psrf).MaxPoint.Z
        self.level_cl = level_cl
        
        crvs = find_periCrvsOn_srf(psrf)
        self.crvs = crvs
        
        startpt_crv = get_PointOf_PeriCrvs(crvs)
        self.startpt_crv = startpt_crv
        
        crv_cvxHull = get_cvxHullFor_cl(startpt_crv)
        self.crv_cvxHull = crv_cvxHull
        
        crv_cvxHull_offin = create_offsetCrv(crv_cvxHull, -10)
        bdrysolid_cvxHull = create_bdrySolid_forInsp(crv_cvxHull)
        self.bdrysolid_cvxHull = bdrysolid_cvxHull
        
        patched_cvxHull = patch_pCrv(crv_cvxHull)

        try:
            diff_srf = Surface.Difference(patched_cvxHull, cl)
            if isinstance(diff_srf, PolySurface):
                div_diff_srflist = PolySurface.Surfaces(diff_srf)
            else:
                div_diff_srflist = [diff_srf]
        except:
            div_diff_srflist = [patched_cvxHull]
        self.div_diff_srflist = div_diff_srflist
        
        outer_srf_diff = list(
        filter(lambda x: Geometry.DoesIntersect(x, bdrysolid_cvxHull), div_diff_srflist))
        self.outer_srf_diff = outer_srf_diff
        inner_srf_diff = list(
        filter(lambda x: Geometry.DoesIntersect(x, bdrysolid_cvxHull) == False, div_diff_srflist))
        if len(inner_srf_diff) == 0:
            pt_cl_bdry = startpt_crv
        else:
            joined_inner_srf = PolySurface.ByJoinedSurfaces(inner_srf_diff)
            pre_pt_cl_bdry = list(
            filter(lambda x: Geometry.DoesIntersect(x, joined_inner_srf) == False, startpt_crv))
            pt_cl_bdry = list(
            filter(lambda x: Geometry.DoesIntersect(x, patch_pCrv(crv_cvxHull_offin)) == False, pre_pt_cl_bdry))
        crvlist_outer_srf = list(map(find_periCrvsOn_srf, outer_srf_diff))
        pt_outer_srf = sum(list(map(get_PointOf_PeriCrvs, crvlist_outer_srf)),[])
        self.pt_outer_srf = pt_outer_srf
        pt_cvx_bdry = list(filter(lambda x: Geometry.DoesIntersect(x, bdrysolid_cvxHull), pt_outer_srf))
 
        preip = list(filter(lambda x: Geometry.DoesIntersect(x, bdrysolid_cvxHull) != True, pt_outer_srf))
        
        def f_nip(x):
            return filter(lambda y: Geometry.DoesIntersect(x, y) == False, cir_ip)

        if len(preip) == 0:
            minX = min(map(lambda x: round(x.X,3), pt_outer_srf))
            maxY = max(map(lambda x: round(x.Y,3), pt_outer_srf))
            pt_X = list(filter(lambda x: round(x.X,3) == minX, pt_outer_srf))
            ip = list(filter(lambda x: round(x.Y,3) == maxY, pt_X))
            cir_ip = list(map(lambda x: Sphere.ByCenterPointRadius(x,1), ip))
            uni_cir_ip = Solid.ByUnion(cir_ip)
            nip = list(filter(lambda x: Geometry.DoesIntersect(x, uni_cir_ip) == False, pt_cl_bdry))
        else:
            ip = list(filter(lambda x: Geometry.DoesIntersect(x, bdrysolid_cvxHull) != True, pt_outer_srf))
            cir_ip = list(map(lambda x: Sphere.ByCenterPointRadius(x,1), ip))
            uni_cir_ip = Solid.ByUnion(cir_ip)
            nip = list(filter(lambda x: Geometry.DoesIntersect(x, uni_cir_ip) == False, pt_cl_bdry))
        self.cir_ip = cir_ip
        self.ip = ip
        self.nip = nip
        qcircle_ip = list(map(lambda x: Sphere.ByCenterPointRadius(x,500), ip))
        self.qcircle_ip = qcircle_ip
        qcircle_nip = list(map(lambda x: Sphere.ByCenterPointRadius(x,500), nip))
        self.qcircle_nip = qcircle_nip
        
    def translate(self, vec):
        self.cl = list(map(lambda x: Geometry.Translate(x, vec), self.cl))
        self.psrf = Geometry.Translate(self.psrf, vec)
        self.ip = list(map(lambda x: Geometry.Translate(x, vec), self.ip))
        self.nip = list(map(lambda x: Geometry.Translate(x, vec), self.nip))
        
    def create_rotationlist_nip(self, origin):
        degreelist = [0, 90, 180, 270]
        return list(map(lambda x: Geometry.Rotate(self.psrf, origin, Vector.ZAxis(), x), degreelist))

### 층별로 클러스터 set 만드는 클래스? 혹은 기능 구간 삽입 필요###
class QlusterSetByLevel:
    def __init__(self, cl):
        data = list(map(lambda x: {'obj': Qluster(x), 'level': str(Qluster(x).level_cl)}, cl))
        grouped_data = itertools.groupby(data, key=operator.itemgetter('level'))
        self.grouped_data = grouped_data
        tmp = {}
        for key, i in grouped_data:
            tmp[key] = list(i)
        keys = list(tmp.keys())
        self.keys = keys
        result = list(map(lambda x: tmp.get(x), keys))
        self.result = result
        Qresult = list(
            map(lambda x: list(
                map(lambda i: i.get('obj'),x)), result))
        self.Qresult = Qresult
    pass

class QsetPlacer: ## clst: cluster set, cl: cluster, clem: cluster elements
    def __init__(self, qsetlist, pBdry):
        ql_obj = list(map(lambda x: x, qsetlist))#i
        self.ql_obj = ql_obj
        pBdry_crvs = PolyCurve.Curves(pBdry[0])
        pBdry_pts = list(map(lambda x: x.StartPoint,pBdry_crvs))
        
        ql = list(map(lambda x: x.cl, ql_obj))
        self.ql = ql
        level_ql = list(map(lambda x: x.level_cl, ql_obj))
        self.level_ql = level_ql
        ql_ip = list(map(lambda x: x.ip, ql_obj))
        self.ql_ip = ql_ip
        ql_nip = list(map(lambda x: x.nip, ql_obj))
        self.ql_nip = ql_nip
        qcircle_ip = list(map(lambda x: x.qcircle_ip, ql_obj))
        self.qcircle_ip = qcircle_ip
        
        pBdry_standardPt = pBdry[0].PointAtParameter(0)
        self.pBdry_standardPt = pBdry_standardPt
        postPlacinglist = []
        self.postPlacinglist = postPlacinglist
        postIPlist = []
        self.postIPlist = postIPlist
        
        def checkIntersect(srf):
            postSrf = PolySurface.ByJoinedSurfaces(postPlacinglist)
            if srf.DoesIntersect(postSrf) == False and srf.DoesIntersect(pBdry) == True:
                return True
            

        def place_init(ql):
            startPt = ql.nip[0]
            endPt = Point.ByCoordinates(pBdry_standardPt.X, pBdry_standardPt.Y, ql.level_cl)
            dirVec = Vector.ByTwoPoints(startPt, endPt)
            ql = ql.translate(dirVec)
            rotList = ql.create_rotationlist_nip(endPt)
            possibleSrfs = list(filter(checkIntersect, rotList))
            postSrf = PolySurface.ByJoinedSurfaces(postPlacinglist)
            result = postSrf
            return result
            
        def place_next(ql):
            startPtlist = ql.nip
            dic_cvxArea = {}
            for startPt in startPtlist:
                #dic_cvxArea = {}
                for ip in postIPlist:
                    #dic_cvxArea = {}
                    endPt = Point.ByCoordinates(ip.X, ip.Y, ql.level_cl)
                    dirVec = Vector.ByTwoPoints(startPt, endPt)
                    ql = ql.translate(dirVec)
                    rotList = ql.create_rotationlist_nip(ip)
                    possibleSrfs = list(filter(checkIntersect, rotList))
                    postSrf = PolySurface.ByJoinedSurfaces(postPlacinglist)
                    
                    for i in possibleSrfs:
                        a = PolySurface.ByJoinedSurfaces([postSrf, i])
                        b = a.PerimeterCurves()
                        c = list(map(lambda x: x.StartPoint,b))
                        d = ConvexHull_Maker(c).result
                        e = d.Area
                        dic_cvxArea[e] = i                      
                        ## possibleSrfs들의 Convex Area 를 딕셔너리화 하고, 가장 작은 Area와 짝지어진 PossibleSrfs를 반환한다
            result = dic_cvxArea.get(min(list(dic_cvxArea.keys()))).Surfaces()
            return result
            
        def update_AllpostIP(srfs):
            #joinedSrf = PolySurface.ByJoinedSurfaces(srfs)
            #AllpostIP = Qluster(joinedSrf).ip
            AllpostIP = list(map(lambda x: Qluster(x).ip, srfs))
            self.postIPlist = []
            self.postIPlist.append(AllpostIP)
#            return result

            

#        placed_init = place_init(qsetlist[0])
#        self.placed_init = placed_init
        
        def place_qlstInFloor(qsetlist):
            postPlacinglist = []
            postIPlist = []
            for i in range(len(qsetlist)):
                if i == 0:
                    postPlacinglist.append(place_init(qsetlist[i]))
                    update_AllpostIP(postPlacinglist)
                else:
                    postPlacinglist.append(place_next(qsetlist[i]))
                    update_AllpostIP(postPlacinglist)
            return postPlacinglist
            
        placedSrfs = place_qlstInFloor(qsetlist)
        self.placedSrfs = placedSrfs




# Place your code below this line
def colorize(i,r,g,b):
	return GeometryColor.ByGeometryColor(i, Color.ByARGB(125, r, g, b))


qset = QlusterSetByLevel(InList).Qresult[1]
QS_obj = QsetPlacer(qset, PlacingBoundary)



k = QS_obj.ql
l = QS_obj.qcircle_ip
m = QS_obj.ql_obj
#n = QS_obj.obj_rotated
o = QlusterSetByLevel(InList).result
p = QlusterSetByLevel(InList).Qresult
q = QS_obj.placedSrfs

# Assign your output to the OUT variable.
OUT = (k,l,m,o,p,q)#(b,d,e,f,h,i,j,k)
# ----------------------------------------
code_block_147 = CodeBlock(i=python_script_20210924) { i[5]; }
python_script_20210927 = Python(IN[0]=code_block_141.i, IN[1]=code_block_143)  # CPython3
# ---------- python_script_20210927.python (376 lines) ----------
# Load the Python Standard and DesignScript Libraries
from random import randint
import sys
import clr
clr.AddReference('ProtoGeometry')
from Autodesk.DesignScript.Geometry import *
clr.AddReference('DSCoreNodes')
from DSCore import *
from DSCore import Color
clr.AddReference('GeometryColor')
from Modifiers import GeometryColor
from functools import reduce
import itertools
import operator


# The inputs to this node will be stored as a list in the IN variables.
##############################
dataEnteringNode = IN
InList = IN[0]
PlacingBoundary = IN[1]
pBdry_crvs = PolyCurve.Curves(PlacingBoundary[0])
pBdry_pts = list(map(lambda x: x.StartPoint,pBdry_crvs))
PrePlacingList = []
PostPlacingList = []

###########################################################################

class ConvexHull_Maker:
    def __init__(self, points):
        def convex_hull_graham(points):
            def ToVals(pt):
	            return [pt.X,pt.Y,pt.Z]
            def ToPts(ptVals):
	            return Point.ByCoordinates(ptVals[0],ptVals[1],ptVals[2])
	           
            def CreateOutline(pts):
                crvs = []
                i = 0
                while i < len(pts):
                    if i == len(pts)-1:
                        crvs.append(Line.ByStartPointEndPoint(pts[i],pts[0]))
                    else:
                        crvs.append(Line.ByStartPointEndPoint(pts[i],pts[i+1]))
                    i = i+1
                return PolyCurve.ByJoinedCurves(crvs)
	
            TURN_LEFT, TURN_RIGHT, TURN_NONE = (1, -1, 0)

            def cmp(a, b):
                return (a > b) - (a < b)
	
            def turn(p, q, r):
                return cmp((q[0] - p[0])*(r[1] - p[1]) - (r[0] - p[0])*(q[1] - p[1]), 0)
	
            def _keep_left(hull, r):
                while len(hull) > 1 and turn(hull[-2], hull[-1], r) != TURN_LEFT:
                    hull.pop()
                if not len(hull) or hull[-1] != r:
                    hull.append(r)
                return hull

            points = [ToVals(p) for p in points]	
            points = sorted(points)
            l = reduce(_keep_left, points, [])
            u = reduce(_keep_left, reversed(points), [])
            points = l.extend(u[i] for i in range(1, len(u) - 1)) or l
            points = [ToPts(p) for p in points]
            return CreateOutline(points)
            
        self.points = points
        result = convex_hull_graham(points)
        self.result = result

class Qluster:
    def __init__(self, srfs_rooms):
        def create_clusterSrf(srfs):
            return PolySurface.ByJoinedSurfaces(srfs)
        def find_periCrvsOn_srf(psrf):
            return psrf.PerimeterCurves()
        def get_PointOf_PeriCrvs(crvs):
            return list(map(lambda x: x.StartPoint,crvs))
        def get_cvxHull(pts):
            return ConvexHull_Maker(pts).result
        def create_offsetCrv(pcrv, offset):
            return Curve.Offset(pcrv, offset)
        def create_bdrySolid_forInsp(pcrv):
            Crv_offin = Curve.Offset(pcrv,-10)
            Crv_offout = Curve.Offset(pcrv,300)
            srf_on2crv = Surface.ByLoft([Crv_offout, Crv_offin])
            solid_on2crv = Surface.Thicken(srf_on2crv, 1, True)
            return solid_on2crv
        def patch_pCrv(pcrv):
            return Surface.ByPatch(pcrv)
            
        self.srfs_rooms = srfs_rooms
        
        psrf_cluster = create_clusterSrf(srfs_rooms)
        self.psrf_cluster = psrf_cluster
        
        level_cluster = BoundingBox.ByGeometry(psrf_cluster).MaxPoint.Z
        self.level_cluster = level_cluster
        
        crvs_cluster = find_periCrvsOn_srf(psrf_cluster)
        self.crvs_cluster = crvs_cluster
        
        pts_cluster = get_PointOf_PeriCrvs(crvs_cluster)
        self.pts_cluster = pts_cluster
        
        cvxCrv_cluster = get_cvxHull(pts_cluster)
        self.cvxCrv_cluster = cvxCrv_cluster
        
        cvxCrv_offin = create_offsetCrv(cvxCrv_cluster, -10)
        solid_cvxHull = create_bdrySolid_forInsp(cvxCrv_cluster)
        self.solid_cvxHull = solid_cvxHull
        
        patched_cvxCrv_offin = patch_pCrv(cvxCrv_offin)

        try:
            diff_srf = Surface.Difference(patched_cvxCrv_offin, srfs_rooms)
            if isinstance(diff_srf, PolySurface):
                div_diff_srflist = PolySurface.Surfaces(diff_srf)
            else:
                div_diff_srflist = [diff_srf]
        except:
            div_diff_srflist = [patched_cvxCrv_offin]
        self.div_diff_srflist = div_diff_srflist
        
        outer_srf_diff = list(filter(lambda x: Geometry.DoesIntersect(x, solid_cvxHull), div_diff_srflist))
        self.outer_srf_diff = outer_srf_diff
        inner_srf_diff = list(
        filter(lambda x: Geometry.DoesIntersect(x, solid_cvxHull) == False, div_diff_srflist))
        if len(inner_srf_diff) == 0:
            pt_cl_bdry = pts_cluster
        else:
            joined_inner_srf = PolySurface.ByJoinedSurfaces(inner_srf_diff)
            pre_pt_cl_bdry = list(
            filter(lambda x: Geometry.DoesIntersect(x, joined_inner_srf) == False, pts_cluster))
            pt_cl_bdry = list(
            filter(lambda x: Geometry.DoesIntersect(x, patch_pCrv(cvxCrv_offin)) == False, pre_pt_cl_bdry))
        crvlist_outer_srf = list(map(find_periCrvsOn_srf, outer_srf_diff))
        pt_outer_srf = sum(list(map(get_PointOf_PeriCrvs, crvlist_outer_srf)),[])
        self.pt_outer_srf = pt_outer_srf
        pt_cvx_bdry = list(filter(lambda x: Geometry.DoesIntersect(x, solid_cvxHull), pt_outer_srf))
 
        preip = list(filter(lambda x: Geometry.DoesIntersect(x, solid_cvxHull) != True, pt_outer_srf))
        
        def f_nip(x):
            return filter(lambda y: Geometry.DoesIntersect(x, y) == False, cir_ip)

        if len(preip) == 0:
            minX = min(map(lambda x: round(x.X,3), pt_outer_srf))
            maxY = max(map(lambda x: round(x.Y,3), pt_outer_srf))
            pt_X = list(filter(lambda x: round(x.X,3) == minX, pt_outer_srf))
            ip = list(filter(lambda x: round(x.Y,3) == maxY, pt_X))
            cir_ip = list(map(lambda x: Sphere.ByCenterPointRadius(x,1), ip))
            uni_cir_ip = Solid.ByUnion(cir_ip)
            nip = list(filter(lambda x: Geometry.DoesIntersect(x, uni_cir_ip) == False, pt_cl_bdry))
        else:
            ip = list(filter(lambda x: Geometry.DoesIntersect(x, solid_cvxHull) != True, pt_outer_srf))
            cir_ip = list(map(lambda x: Sphere.ByCenterPointRadius(x,1), ip))
            uni_cir_ip = Solid.ByUnion(cir_ip)
            nip = list(filter(lambda x: Geometry.DoesIntersect(x, uni_cir_ip) == False, pt_cl_bdry))
        self.cir_ip = cir_ip
        self.ip = ip
        self.nip = nip
        qcircle_ip = list(map(lambda x: Sphere.ByCenterPointRadius(x,500), ip))
        self.qcircle_ip = qcircle_ip
        qcircle_nip = list(map(lambda x: Sphere.ByCenterPointRadius(x,500), nip))
        self.qcircle_nip = qcircle_nip
        
    def translate(self, vec):
        self.srfs_rooms = list(map(lambda x: Geometry.Translate(x, vec), self.srfs_rooms))
        self.psrf_cluster = Geometry.Translate(self.psrf_cluster, vec)
        self.ip = list(map(lambda x: Geometry.Translate(x, vec), self.ip))
        self.nip = list(map(lambda x: Geometry.Translate(x, vec), self.nip))
        
    def create_rotationlist_nip(self, origin):
        degreelist = [0, 90, 180, 270]
        return list(map(lambda x: Geometry.Rotate(self.psrf_cluster, origin, Vector.ZAxis(), x), degreelist))

### 층별로 클러스터 set 만드는 클래스? 혹은 기능 구간 삽입 필요###
class QlusterSetByLevel:
    def __init__(self, srfs_totalrooms):
        data = list(map(lambda x: {'obj': Qluster(x), 'level': str(Qluster(x).level_cluster)}, srfs_totalrooms))
        grouped_data = itertools.groupby(data, key=operator.itemgetter('level'))
        self.grouped_data = grouped_data
        tmp = {}
        for key, i in grouped_data:
            tmp[key] = list(i)
        keys = list(tmp.keys())
        self.keys = keys
        result = list(map(lambda x: tmp.get(x), keys))
        self.result = result
        Qset = list(
                map(lambda x: list(
                    map(lambda i: i.get('obj'),x)), result))
        self.Qset = Qset
    pass

class QsetPlacer:
    def __init__(self, qset, placingBdry):
        self.qset = qset
        
        crvs_placingBdry = PolyCurve.Curves(placingBdry[0])
        pts_placingBdry = list(map(lambda x: x.StartPoint,pBdry_crvs))
        pcrv_offin = Curve.Offset(placingBdry[0], -1)
        solid_placingBdry = Surface.ByPatch(pcrv_offin).Thicken(100000, True)
        
        srf_cluster = list(map(lambda x: x.srfs_rooms, qset)) #x.srfs_rooms // psrf_cluster
        self.srf_cluster = srf_cluster
        
        level_qluster = list(map(lambda x: x.level_cluster, qset))
        self.level_qluster = level_qluster
        
        qluster_ip = list(map(lambda x: x.ip, qset))
        self.qluster_ip = qluster_ip
        
        qluster_nip = list(map(lambda x: x.nip, qset))
        self.qluster_nip = qluster_nip
        
        qcircle_ip = list(map(lambda x: x.qcircle_ip, qset))
        self.qcircle_ip = qcircle_ip
        
        stdPt_placingBdry = placingBdry[0].PointAtParameter(0)
        self.stdPt_placingBdry = stdPt_placingBdry
        
        postPlacinglist = []
        self.postPlacinglist = postPlacinglist
        
        postIPlist = []
        self.postIPlist = postIPlist
        
#        def checkIntersect(srf):
#            postSrf = PolySurface.ByJoinedSurfaces(postPlacinglist)
#            if srf.DoesIntersect(postSrf) == False and srf.DoesIntersect(pBdry) == True:
#                return True
#            
        def create_rotationlist(srf, origin):
            degreelist = [0, 90, 180, 270]
            return list(map(lambda x: Geometry.Rotate(srf, origin, Vector.ZAxis(), x), degreelist))

        def place_init(qluster, solid_placingBdry):
            startPts = qluster.nip
            endPt = Point.ByCoordinates(stdPt_placingBdry.X, stdPt_placingBdry.Y, qluster.level_cluster)
            
            possibleSrfs = []
            for startPt in startPts:
                dirVec = Vector.ByTwoPoints(startPt, endPt)
                psrf_cluster = qluster.psrf_cluster
                psrfs_cluster_rotate = create_rotationlist(psrf_cluster, startPt)
                psrfs_cluster_rotate_tr = list(map(lambda x: Geometry.Translate(x, dirVec), psrfs_cluster_rotate))
                possibleSrfs.extend(list(filter(lambda x: x.DoesIntersect(solid_placingBdry), psrfs_cluster_rotate_tr)))
            
            dic = {}
            for i in possibleSrfs:
                geo_intsct = i.Intersect(solid_placingBdry)
                area_polysrf_intsct = PolySurface.ByJoinedSurfaces(list(geo_intsct)).Area
                dic[area_polysrf_intsct] = i
            result = dic.get(max(list(dic.keys())))
            return result
            
            
        def place_next(qluster, solid_placingBdry, postPlacinglist):
            startPts = qluster.ip
            psrf_postPlacinglist = PolySurface.ByJoinedSurfaces(postPlacinglist)
            endPts = Qluster(psrf_postPlacinglist.Surfaces()).nip
            
            possibleSrfs = []
            for startPt in startPts:
                for endPt in endPts:
                    dirVec = Vector.ByTwoPoints(startPt, endPt)
                    psrf_cluster = qluster.psrf_cluster
                    psrfs_cluster_rotate = create_rotationlist(psrf_cluster, startPt)
                    psrfs_cluster_rotate_tr = list(map(lambda x: Geometry.Translate(x, dirVec), psrfs_cluster_rotate))
                    possibleSrfs.extend(list(filter(lambda x: x.DoesIntersect(solid_placingBdry), psrfs_cluster_rotate_tr)))
                    #possibleSrfs.extend(list(filter(lambda x: x.Intersect(psrf_postPlacinglist) != True, psrfs_cluster_rotate_tr)))
                    
            dic = {}
            for i in possibleSrfs:
                #geo_intsct = psrf_postPlacinglist
                geo_intsct = list(i.Intersect(psrf_postPlacinglist.Thicken(100000,True)))
                #area_polysrf_intsct = reduce(lambda acc, cur: acc + cur.Area, geo_intsct, 0)

#                dic[area_polysrf_intsct] = i
#            result = dic.get(min(list(dic.keys())))
            result = geo_intsct
            return result
            pass





        srf_initplaced = place_init(qset[0], solid_placingBdry)
        self.srf_initplaced = srf_initplaced
        postPlacinglist.append(srf_initplaced)
        self.postPlacinglist = postPlacinglist
        
        srf_nextplaced = place_next(qset[1], solid_placingBdry, postPlacinglist)
        self.srf_nextplaced = srf_nextplaced

#        def place_next(ql):
#            startPtlist = ql.nip
#            dic_cvxArea = {}
#            for startPt in startPtlist:
#                #dic_cvxArea = {}
#                for ip in postIPlist:
#                    #dic_cvxArea = {}
#                    endPt = Point.ByCoordinates(ip.X, ip.Y, ql.level_cl)
#                    dirVec = Vector.ByTwoPoints(startPt, endPt)
#                    ql = ql.translate(dirVec)
#                    rotList = ql.create_rotationlist_nip(ip)
#                    possibleSrfs = list(filter(checkIntersect, rotList))
#                    postSrf = PolySurface.ByJoinedSurfaces(postPlacinglist)
#                    
#                    for i in possibleSrfs:
#                        a = PolySurface.ByJoinedSurfaces([postSrf, i])
#                        b = a.PerimeterCurves()
#                        c = list(map(lambda x: x.StartPoint,b))
#                        d = ConvexHull_Maker(c).result
#                        e = d.Area
#                        dic_cvxArea[e] = i                      
#                        ## possibleSrfs들의 Convex Area 를 딕셔너리화 하고, 가장 작은 Area와 짝지어진 PossibleSrfs를 반환한다
#            result = dic_cvxArea.get(min(list(dic_cvxArea.keys()))).Surfaces()
#            return result
#            
#        def update_AllpostIP(srfs):
#            AllpostIP = list(map(lambda x: Qluster(x).ip, srfs))
#            self.postIPlist = []
#            self.postIPlist.append(AllpostIP)
#
#
#            
#
#
#        
#        def place_qlstInFloor(qset):
#            postPlacinglist = []
#            postIPlist = []
#            for i in range(len(qset)):
#                if i == 0:
#                    postPlacinglist.append(place_init(qset[i]))
#                    update_AllpostIP(postPlacinglist)
#                else:
#                    postPlacinglist.append(place_next(qset[i]))
#                    update_AllpostIP(postPlacinglist)
#            return postPlacinglist
#            
#        placedSrfs = place_qlstInFloor(qset)
#        self.placedSrfs = placedSrfs




# Place your code below this line
def colorize(i,r,g,b):
	return GeometryColor.ByGeometryColor(i, Color.ByARGB(125, r, g, b))

i = 3

#QS_obj = QsetPlacer(qset, PlacingBoundary)
#k = QS_obj.qluster
#l = QS_obj.qcircle_ip
#m = QS_obj.qset
#n = QS_obj.obj_rotated
#o = QlusterSetByLevel(InList).result
#q = QS_obj.placedSrfs


a = QlusterSetByLevel(InList)
qset = QlusterSetByLevel(InList).Qset[i]
b = QsetPlacer(qset, PlacingBoundary)
#b = QsetPlacer(a[i])
# Assign your output to the OUT variable.
OUT = {"A": a.Qset[i], "B": b.srf_cluster, "C": b.srf_initplaced, "D": b.srf_nextplaced}
# ----------------------------------------
code_block_148 = CodeBlock { "D"; }
valueAtKey_59 = DesignScript.Builtin.Dictionary.ValueAtKey(dictionary=python_script_20210927, key=code_block_148)
code_block_149 = CodeBlock(i=valueAtKey_59) { i; }
code_block_150 = CodeBlock(i=code_block_149) { i[1]; }
perimeterCurves_3 = Surface.PerimeterCurves(surface=code_block_150)
byJoinedSurfaces = PolySurface.ByJoinedSurfaces()  # unwired: surfaces
