# Dynamo graph 1007 space planning test 001.dyn (Dynamo 2.10.1.3976)
# packages: GenerativeDesign.Revit 1.7.3.0, GenerativeDesign 1.7.3.0

# group: User Inputs for GDIR
# note: Custom Package: GenerativeDesign v.2021.5.5
select_room_to_load_program_into = DSModelRoomSelection()  # 1 picked in the model; graph input
# note: Retrieve the room's finish boundary.
# Note: The first sublist is the outermost boundary of the room.
finishBoundary = Room.FinishBoundary(room=select_room_to_load_program_into)
remember = Data.Remember(finishBoundary)

# group: Extract room boundary for DynaSpace and cache it in the graph
firstItem = List.FirstItem(list=remember@L3)
startPoint = Curve.StartPoint(curve=firstItem)
flatten = List.Flatten(list=startPoint)
byJoinedCurves = PolyCurve.ByJoinedCurves(curves=firstItem)
code_block = CodeBlock(BldgBoundary=byJoinedCurves)
# ---------- code_block.designscript (3 lines) ----------
{
"BldgBoundary": _BldgBoundary
};
# ----------------------------------------

# group: 고정부 Seed
seed_고정부_코어 = DoubleSlider(200, range=0..999 step 100)  # graph input

# group: 변동부 Seed
seed_변형부_공간 = DoubleSlider(300, range=0..999 step 100)  # graph input

# group: 회전 Seed
seed_회전용 = DoubleSlider(800, range=0..999 step 100)  # graph input

# group: Floor Level
code_block_2 = CodeBlock { [-6000, 0, 6000, 12000]; }

code_block_3 = CodeBlock(FixedPartSeed=seed_고정부_코어, NonFixedPartSeed=seed_변형부_공간, RotatingSeed=seed_회전용, FloorLevel=code_block_2)
# ---------- code_block_3.designscript (6 lines) ----------
{
"FixedPartSeed": _FixedPartSeed,
"NonFixedPartSeed": _NonFixedPartSeed,
"RotatingSeed": _RotatingSeed,
"FloorLevel": _FloorLevel
};
# ----------------------------------------
extendsChildDictionaryFromParent = Custom[ExtendsChildDictionaryFromParent](ParentDic=code_block, ChildDic=code_block_3)  # Extends Child Dictionary From Parent

# group: Excel Data import (package 정리 전)
file_path = Filename("..\0827\space planning test 0802mk 001.xlsx")
file_from_path = FileObject(path=file_path)
string_from_object = FromObject(object=file_from_path)
code_block_4 = CodeBlock { "Sheet1"; "SampleBuildingProgram-Clinic"; false; }
python_script_import_excel_by = Python(IN[0]=string_from_object, IN[1]=code_block_4.out0)  # "Python Script@Import Excel(By OpenpyXl)"; CPython3
# ---------- python_script_import_excel_by.python (50 lines) ----------
# Load the Python Standard and DesignScript Libraries
import sys
import os
#sys.path.append(r'C:\Users\HEC\AppData\Local\Programs\Python\Python39\Lib\site-packages')
#sys.path.append(r'C:\Users\pjmk0\AppData\Local\Programs\Python\Python39\Lib\site-packages')
sys.path.append(os.getenv('LOCALAPPDATA').replace('\\','\\\\') + r'\Programs\Python\Python39\Lib\site-packages')
import clr
clr.AddReference('ProtoGeometry')
from Autodesk.DesignScript.Geometry import *
from collections import Iterable

def iterable(obj):
    return isinstance(obj, Iterable)


# The inputs to this node will be stored as a list in the IN variables.
dataEnteringNode = IN
PathIn = IN[0]
SheetNameIn = IN[1]

# Place your code below this line
import datetime
import openpyxl

path = (PathIn)
#path = (r'C:\Users\pjmk0\Downloads\MK\mQ\BIM_물량집계 자동화 산출기준표_rC(20210607)_mk_de.xlsx')

wb_obj = openpyxl.load_workbook(path, data_only=True)
sheet_obj = wb_obj.get_sheet_by_name(SheetNameIn)

m_row = sheet_obj.max_row
m_col = sheet_obj.max_column

listOut = []



for i in range(1, m_row +1):
    listTemp = []
    for j in range(1, m_col + 1):
        cell_obj = sheet_obj.cell(row=i, column=j)
        listTemp.append(cell_obj.value)
        if len(listTemp) == m_col:
            listOut.append(listTemp)
        


# Assign your output to the OUT variable.
OUT = listOut
#OUT = os.getenv('APPDATA')
# ----------------------------------------
excel_data_정리_전 = Watch(python_script_import_excel_by)

remember_2 = Data.Remember(excel_data_정리_전)

# group: Excel List 분할
excel_data_정리_전_2 = Watch(remember_2)
transpose = List.Transpose(lists=excel_data_정리_전_2)
# note: List Name 정리
code_block_5 = CodeBlock { 1; }
dropItems = List.DropItems(list=transpose@L2, amount=code_block_5)
watch = Watch(dropItems)
code_block_6 = CodeBlock { 0; }
getItemAtIndex = List.GetItemAtIndex(list=watch, index=code_block_6)
space_id = Watch(getItemAtIndex)
code_block_7 = CodeBlock { 1; }
getItemAtIndex_2 = List.GetItemAtIndex(list=watch, index=code_block_7)
space_name = Watch(getItemAtIndex_2)
code_block_8 = CodeBlock { 10; }
getItemAtIndex_3 = List.GetItemAtIndex(list=watch, index=code_block_8)
adjacent_spaces = Watch(getItemAtIndex_3)
code_block_9 = CodeBlock { 3; }
getItemAtIndex_4 = List.GetItemAtIndex(list=watch, index=code_block_9)
department_id = Watch(getItemAtIndex_4)
code_block_10 = CodeBlock { 2; }
getItemAtIndex_5 = List.GetItemAtIndex(list=watch, index=code_block_10)
DEPARTMENT = Watch(getItemAtIndex_5)
code_block_11 = CodeBlock { 11; }
getItemAtIndex_6 = List.GetItemAtIndex(list=watch, index=code_block_11)
lev = Watch(getItemAtIndex_6)
code_block_12 = CodeBlock { 5; }
getItemAtIndex_7 = List.GetItemAtIndex(list=watch, index=code_block_12)
WIDTH = Watch(getItemAtIndex_7)
code_block_13 = CodeBlock { 6; }
getItemAtIndex_8 = List.GetItemAtIndex(list=watch, index=code_block_13)
length = Watch(getItemAtIndex_8)
code_block_14 = CodeBlock { 7; }
getItemAtIndex_9 = List.GetItemAtIndex(list=watch, index=code_block_14)
height = Watch(getItemAtIndex_9)
code_block_15 = CodeBlock { 8; }
getItemAtIndex_10 = List.GetItemAtIndex(list=watch, index=code_block_15)
AREA = Watch(getItemAtIndex_10)
code_block_16 = CodeBlock { 14; }
getItemAtIndex_11 = List.GetItemAtIndex(list=watch, index=code_block_16)
ROTATE = Watch(getItemAtIndex_11)
code_block_17 = CodeBlock { 15; }
getItemAtIndex_12 = List.GetItemAtIndex(list=watch, index=code_block_17)
CLUSTER = Watch(getItemAtIndex_12)
code_block_18 = CodeBlock(ExcelDataWithNoHead=watch, SpaceID=space_id, SpaceName=space_name, AdjacentSpaces=adjacent_spaces, DepartmentID=department_id, Department=DEPARTMENT, Level=lev, Width=WIDTH, Length=length, Height=height, Area=AREA, Rotate=ROTATE, Cluster=CLUSTER)
# ---------- code_block_18.designscript (15 lines) ----------
{
"ExcelDataWithNoHead": _ExcelDataWithNoHead,
"SpaceID": _SpaceID,
"SpaceName": _SpaceName,
"AdjacentSpaces": _AdjacentSpaces,
"DepartmentID": _DepartmentID,
"Department": _Department,
"Level": _Level,
"Width": _Width,
"Length": _Length,
"Height": _Height,
"Area": _Area,
"Rotate": _Rotate,
"Cluster": _Cluster
};
# ----------------------------------------

code_block_19 = CodeBlock(InputDic=code_block_18) { _InputDic; }
code_block_20 = CodeBlock { "SpaceID"; }
valueAtKey = DesignScript.Builtin.Dictionary.ValueAtKey(dictionary=code_block_19, key=code_block_20)
code_block_21 = CodeBlock { "SpaceName"; }
valueAtKey_2 = DesignScript.Builtin.Dictionary.ValueAtKey(dictionary=code_block_19, key=code_block_21)
code_block_22 = CodeBlock { "AdjacentSpaces"; }
valueAtKey_3 = DesignScript.Builtin.Dictionary.ValueAtKey(dictionary=code_block_19, key=code_block_22)
code_block_23 = CodeBlock { "DepartmentID"; }
valueAtKey_4 = DesignScript.Builtin.Dictionary.ValueAtKey(dictionary=code_block_19, key=code_block_23)
code_block_24 = CodeBlock { "Department"; }
valueAtKey_5 = DesignScript.Builtin.Dictionary.ValueAtKey(dictionary=code_block_19, key=code_block_24)
code_block_25 = CodeBlock { "Level"; }
valueAtKey_6 = DesignScript.Builtin.Dictionary.ValueAtKey(dictionary=code_block_19, key=code_block_25)
code_block_26 = CodeBlock { "Width"; }
valueAtKey_7 = DesignScript.Builtin.Dictionary.ValueAtKey(dictionary=code_block_19, key=code_block_26)
code_block_27 = CodeBlock { "Length"; }
valueAtKey_8 = DesignScript.Builtin.Dictionary.ValueAtKey(dictionary=code_block_19, key=code_block_27)
code_block_28 = CodeBlock { "Height"; }
valueAtKey_9 = DesignScript.Builtin.Dictionary.ValueAtKey(dictionary=code_block_19, key=code_block_28)
code_block_29 = CodeBlock { "Area"; }
valueAtKey_10 = DesignScript.Builtin.Dictionary.ValueAtKey(dictionary=code_block_19, key=code_block_29)
code_block_30 = CodeBlock { "Rotate"; }
valueAtKey_11 = DesignScript.Builtin.Dictionary.ValueAtKey(dictionary=code_block_19, key=code_block_30)
code_block_31 = CodeBlock { "Cluster"; }
valueAtKey_12 = DesignScript.Builtin.Dictionary.ValueAtKey(dictionary=code_block_19, key=code_block_31)
code_block_32 = CodeBlock(BoxSpaceID=valueAtKey, BoxSpaceName=valueAtKey_2, BoxAdjacentSpaces=valueAtKey_3, BoxDepartmentID=valueAtKey_4, BoxDepartment=valueAtKey_5, BoxLevel=valueAtKey_6, BoxWidth=valueAtKey_7, BoxLength=valueAtKey_8, BoxHeight=valueAtKey_9, BoxArea=valueAtKey_10, BoxRotate=valueAtKey_11, BoxCluster=valueAtKey_12)
# ---------- code_block_32.designscript (15 lines) ----------
///Box Class Primary
{
"BoxSpaceID": _BoxSpaceID,
"BoxSpaceName": _BoxSpaceName,
"BoxAdjacentSpaces": _BoxAdjacentSpaces,
"BoxDepartmentID": _BoxDepartmentID,
"BoxDepartment": _BoxDepartment,
"BoxLevel": _BoxLevel,
"BoxWidth": _BoxWidth,
"BoxLength": _BoxLength,
"BoxHeight": _BoxHeight,
"BoxArea": _BoxArea,
"BoxRotate": _BoxRotate,
"BoxCluster": _BoxCluster
};
# ----------------------------------------
code_block_33 = CodeBlock(BoxClass_Primary=code_block_32)
# ---------- code_block_33.designscript (3 lines) ----------
{
"BoxClass_Primary": _BoxClass_Primary
};
# ----------------------------------------
extendsChildDictionaryFromParent_2 = Custom[ExtendsChildDictionaryFromParent](ParentDic=extendsChildDictionaryFromParent.dictionary, ChildDic=code_block_33)
watch_2 = Watch(extendsChildDictionaryFromParent_2.key)
code_block_34 = CodeBlock(InputDic=extendsChildDictionaryFromParent_2.dictionary) { _InputDic; }
setBoxZvalueProp = Custom[SetBoxZvalueProp](InputDic=code_block_34)  # SetBoxZvalueProp

# group: 룸 BoundingBox 그리드 포인트 생성
code_block_35 = CodeBlock(InputDic=setBoxZvalueProp) { _InputDic; }
code_block_36 = CodeBlock { "BldgBoundary"; }
valueAtKey_13 = DesignScript.Builtin.Dictionary.ValueAtKey(dictionary=code_block_35, key=code_block_36)
byGeometry = BoundingBox.ByGeometry(geom=valueAtKey_13)
minPoint = BoundingBox.MinPoint(boundingBox=byGeometry)
X = Point.X(point=minPoint)
maxPoint = BoundingBox.MaxPoint(boundingBox=byGeometry)
X_2 = Point.X(point=maxPoint)
code_block_37 = CodeBlock { 500; }
code_block_38 = CodeBlock(a=X, b=X_2, x=code_block_37) { a..b..x; }
Y = Point.Y(point=minPoint)
Y_2 = Point.Y(point=maxPoint)
code_block_39 = CodeBlock { 500; }
code_block_40 = CodeBlock(a=Y, b=Y_2, x=code_block_39) { a..b..x; }
byCoordinates = Point.ByCoordinates(x=code_block_38, y=code_block_40, lacing=CrossProduct)
flatten_2 = List.Flatten(list=byCoordinates)
code_block_41 = CodeBlock(GridPointOfBldgBoundary=flatten_2)
# ---------- code_block_41.designscript (3 lines) ----------
{
"GridPointOfBldgBoundary": _GridPointOfBldgBoundary
};
# ----------------------------------------
extendsChildDictionaryFromParent_3 = Custom[ExtendsChildDictionaryFromParent](ParentDic=code_block_35, ChildDic=code_block_41)

# group: DistributeRandomSeedForFixedPart
code_block_42 = CodeBlock(InputDic=extendsChildDictionaryFromParent_3.dictionary) { _InputDic; }
distributeRandomSeedForFixedPart = Custom[DistributeRandomSeedForFixedPart](InputDic=code_block_42)  # DistributeRandomSeedForFixedPart

# group: Fixed Part 형상 배치 by Seed(회전 고려)
code_block_43 = CodeBlock(InputDic=distributeRandomSeedForFixedPart) { _InputDic; }
code_block_44 = CodeBlock { "BoxClass_fixedpart"; }
valueAtKey_14 = DesignScript.Builtin.Dictionary.ValueAtKey(dictionary=code_block_43, key=code_block_44)
code_block_45 = CodeBlock { "BoxZvalue"; }
valueAtKey_15 = DesignScript.Builtin.Dictionary.ValueAtKey(dictionary=valueAtKey_14, key=code_block_45)
uniqueItems = List.UniqueItems(list=valueAtKey_15)
code_block_46 = CodeBlock { "BoxClass_fixedpart"; }
code_block_47 = CodeBlock { "BoxGeometry"; }
components = DesignScript.Builtin.Dictionary.Components(dictionary=valueAtKey_14)
addItemToEnd = List.AddItemToEnd(item=code_block_47, list=components.keys)
code_block_48 = CodeBlock { "GridPointOfBldgBoundary"; }
valueAtKey_16 = DesignScript.Builtin.Dictionary.ValueAtKey(dictionary=code_block_43, key=code_block_48)
code_block_49 = CodeBlock { "BoxSeed"; }
valueAtKey_17 = DesignScript.Builtin.Dictionary.ValueAtKey(dictionary=valueAtKey_14, key=code_block_49)
getItemAtIndex_13 = List.GetItemAtIndex(list=valueAtKey_16, index=valueAtKey_17)
X_3 = Point.X(point=getItemAtIndex_13)
Y_3 = Point.Y(point=getItemAtIndex_13)
firstItem_2 = List.FirstItem(list=valueAtKey_15)
code_block_50 = CodeBlock(i=valueAtKey_15, j=firstItem_2) { i+Math.Abs(j/2); }
byCoordinates_2 = Point.ByCoordinates(x=X_3, y=Y_3, z=code_block_50)
code_block_51 = CodeBlock { "BoxWidth"; }
valueAtKey_18 = DesignScript.Builtin.Dictionary.ValueAtKey(dictionary=valueAtKey_14, key=code_block_51)
code_block_52 = CodeBlock { "BoxLength"; }
valueAtKey_19 = DesignScript.Builtin.Dictionary.ValueAtKey(dictionary=valueAtKey_14, key=code_block_52)
code_block_53 = CodeBlock { "BoxHeight"; }
valueAtKey_20 = DesignScript.Builtin.Dictionary.ValueAtKey(dictionary=valueAtKey_14, key=code_block_53)
byLengths = Cuboid.ByLengths(origin=byCoordinates_2, width=valueAtKey_18, length=valueAtKey_19, height=valueAtKey_20)
centroid = Solid.Centroid(solid=byLengths)
ZAxis = Vector.ZAxis()
code_block_54 = CodeBlock { "BoxClass_Primary"; }
valueAtKey_21 = DesignScript.Builtin.Dictionary.ValueAtKey(dictionary=code_block_43, key=code_block_54)
code_block_55 = CodeBlock { "BoxDepartment"; }
valueAtKey_22 = DesignScript.Builtin.Dictionary.ValueAtKey(dictionary=valueAtKey_21, key=code_block_55)
code_block_56 = CodeBlock()
# ---------- code_block_56.designscript (6 lines) ----------
[
"PATHV1",
"PATHV2",
"PATHV3"
];
[];
# ----------------------------------------
contains = String.Contains(str=valueAtKey_22, searchFor=code_block_56.out0@@L1)
boolean = BoolSelector(true)
allIndicesOf = List.AllIndicesOf(list=contains@@L2, item=boolean)
count = List.Count(list=allIndicesOf)
code_block_57 = CodeBlock { 0; }
code_block_58 = CodeBlock { 90; }
code_block_59 = CodeBlock { "RotatingSeed"; }
valueAtKey_23 = DesignScript.Builtin.Dictionary.ValueAtKey(dictionary=code_block_43, key=code_block_59)
randomList = Math.RandomList(amount=count, value1=code_block_57, value2=code_block_58, seed=valueAtKey_23)
code_block_60 = CodeBlock(i=randomList) { i>=45; }
code_block_61 = CodeBlock { 90; 0; }
if_ = If(test=code_block_60, true=code_block_61.out0, false=code_block_61.out1)
count_2 = List.Count(list=allIndicesOf@L2)
ofRepeatedItem = List.OfRepeatedItem(item=if_@L1, amount=count_2@L1)
flatten_3 = List.Flatten(list=ofRepeatedItem)
# note: 고정부 매스
rotate = Geometry.Rotate(geometry=byLengths, origin=centroid, axis=ZAxis, degrees=flatten_3)
addItemToEnd_2 = List.AddItemToEnd(item=rotate, list=components.values)
byKeysValues = DesignScript.Builtin.Dictionary.ByKeysValues(keys=addItemToEnd, values=addItemToEnd_2)
setValueAtKeys = DesignScript.Builtin.Dictionary.SetValueAtKeys(dictionary=code_block_43, keys=code_block_46, values=byKeysValues)

# group: 레벨 별 고정부 비점유 포인트 추출
code_block_62 = CodeBlock(InputDic=setValueAtKeys) { _InputDic; }
code_block_63 = CodeBlock { "GridPointOfBldgBoundary"; }
valueAtKey_24 = DesignScript.Builtin.Dictionary.ValueAtKey(dictionary=code_block_62, key=code_block_63)
X_4 = Point.X(point=valueAtKey_24)
Y_4 = Point.Y(point=valueAtKey_24)
code_block_64 = CodeBlock { "BoxClass_fixedpart"; }
valueAtKey_25 = DesignScript.Builtin.Dictionary.ValueAtKey(dictionary=code_block_62, key=code_block_64)
code_block_65 = CodeBlock { "BoxZvalue"; }
valueAtKey_26 = DesignScript.Builtin.Dictionary.ValueAtKey(dictionary=valueAtKey_25, key=code_block_65)
uniqueItems_2 = List.UniqueItems(list=valueAtKey_26)
byCoordinates_3 = Point.ByCoordinates(x=X_4, y=Y_4, z=uniqueItems_2@L1)
code_block_66 = CodeBlock { "BoxGeometry"; }
valueAtKey_27 = DesignScript.Builtin.Dictionary.ValueAtKey(dictionary=valueAtKey_25, key=code_block_66)
byUnion = Solid.ByUnion(solids=valueAtKey_27)
doesIntersect = Geometry.DoesIntersect(geometry=byCoordinates_3, other=byUnion)
filterByBoolMask = List.FilterByBoolMask(list=byCoordinates_3@L2, mask=doesIntersect@L2)
watch_3 = Watch(filterByBoolMask.out)
code_block_67 = CodeBlock(RestGridPointByLevel=watch_3)
# ---------- code_block_67.designscript (3 lines) ----------
{
"RestGridPointByLevel": _RestGridPointByLevel
};
# ----------------------------------------
extendsChildDictionaryFromParent_4 = Custom[ExtendsChildDictionaryFromParent](ParentDic=code_block_62, ChildDic=code_block_67)

code_block_68 = CodeBlock(i=filterByBoolMask.out) { i; }

# group: FindNonFixedPartBox
code_block_69 = CodeBlock(InputDic=extendsChildDictionaryFromParent_4.dictionary) { _InputDic; }
findNonFixedPartBox = Custom[FindNonFixedPartBox](InputDic=code_block_69)  # FindNonFixedPartBox

# group: DistributeRandomSeedForNonFixedPart
code_block_70 = CodeBlock(InputDic=findNonFixedPartBox) { _InputDic; }
distributeRandomSeedForNonFixedPart = Custom[DistributeRandomSeedForNonFixedPart](InputDic=code_block_70)  # DistributeRandomSeedForNonFixedPart

# group: 비 고정부 클러스터링 딕셔너리 형성
code_block_71 = CodeBlock(InputDic=distributeRandomSeedForNonFixedPart) { _InputDic; }
code_block_72 = CodeBlock { "BoxClass_nonfixedpart"; }
valueAtKey_28 = DesignScript.Builtin.Dictionary.ValueAtKey(dictionary=code_block_71, key=code_block_72)
code_block_73 = CodeBlock { "BoxCluster"; }
valueAtKey_29 = DesignScript.Builtin.Dictionary.ValueAtKey(dictionary=valueAtKey_28, key=code_block_73)
uniqueItems_3 = List.UniqueItems(list=valueAtKey_29)
list_allindicesof = List.AllIndicesOf(list=valueAtKey_29, item=uniqueItems_3)
count_3 = List.Count(list=list_allindicesof@L2)
components_2 = DesignScript.Builtin.Dictionary.Components(dictionary=valueAtKey_28)
getItemAtIndex_14 = List.GetItemAtIndex(list=components_2.values@L2, index=list_allindicesof)
byKeysValues_2 = DesignScript.Builtin.Dictionary.ByKeysValues(keys=components_2.keys, values=getItemAtIndex_14)
code_block_74 = CodeBlock(BoxClass_nonfixedclu=byKeysValues_2)
# ---------- code_block_74.designscript (3 lines) ----------
{
"BoxClass_nonfixedclustered": _BoxClass_nonfixedclustered
};
# ----------------------------------------
extendsChildDictionaryFromParent_5 = Custom[ExtendsChildDictionaryFromParent](ParentDic=code_block_71, ChildDic=code_block_74)

# group: 클러스터별 지오메트리 형성(랜덤회전 반영)
code_block_75 = CodeBlock(InputDic=extendsChildDictionaryFromParent_5.dictionary) { _InputDic; }
code_block_76 = CodeBlock { "BldgBoundary"; }
valueAtKey_30 = DesignScript.Builtin.Dictionary.ValueAtKey(dictionary=code_block_75, key=code_block_76)
code_block_77 = CodeBlock { "BoxClass_nonfixedclustered"; }
code_block_78 = CodeBlock { "BoxClass_nonfixedclustered"; }
valueAtKey_31 = DesignScript.Builtin.Dictionary.ValueAtKey(dictionary=code_block_75, key=code_block_78)
code_block_79 = CodeBlock { "BoxWidth"; }
valueAtKey_32 = DesignScript.Builtin.Dictionary.ValueAtKey(dictionary=valueAtKey_31, key=code_block_79)
code_block_80 = CodeBlock { "BoxLength"; }
valueAtKey_33 = DesignScript.Builtin.Dictionary.ValueAtKey(dictionary=valueAtKey_31, key=code_block_80)
byWidthLength = Rectangle.ByWidthLength(width=valueAtKey_32, length=valueAtKey_33)
center = Polygon.Center(polygon=byWidthLength)
ZAxis_2 = Vector.ZAxis()
code_block_81 = CodeBlock { [0,90,180,270]; }
count_4 = List.Count(list=byWidthLength@L2)
code_block_82 = CodeBlock { 0; 3; }
count_5 = List.Count(list=count_4@L2)
code_block_83 = CodeBlock { 0; 999; }
code_block_84 = CodeBlock { "RotatingSeed"; }
valueAtKey_34 = DesignScript.Builtin.Dictionary.ValueAtKey(dictionary=code_block_75, key=code_block_84)
randomList_2 = Math.RandomList(amount=count_5, value1=code_block_83.out0, value2=code_block_83.out1, seed=valueAtKey_34)
randomList_3 = Math.RandomList(amount=count_4@L2, value1=code_block_82.out0, value2=code_block_82.out1, seed=randomList_2@L2)
round = Math.Round(number=randomList_3)
getItemAtIndex_15 = List.GetItemAtIndex(list=code_block_81, index=round)
flatten_4 = List.Flatten(list=getItemAtIndex_15@L2)
rotate_2 = Geometry.Rotate(geometry=byWidthLength, origin=center, axis=ZAxis_2, degrees=flatten_4)
code_block_85 = CodeBlock(RotatedRectangle=rotate_2)
# ---------- code_block_85.designscript (3 lines) ----------
{
"RotatedRectangle": _RotatedRectangle
};
# ----------------------------------------
extendsChildDictionaryFromParent_6 = Custom[ExtendsChildDictionaryFromParent](ParentDic=valueAtKey_31, ChildDic=code_block_85)
setValueAtKeys_2 = DesignScript.Builtin.Dictionary.SetValueAtKeys(dictionary=code_block_75, keys=code_block_77, values=extendsChildDictionaryFromParent_6.dictionary)

# group: Bldg 장변 방향 종속 Space 처리
code_block_86 = CodeBlock(InputDic=setValueAtKeys_2) { _InputDic; }
code_block_87 = CodeBlock { "BoxClass_nonfixedclustered"; }
removeKeys = DesignScript.Builtin.Dictionary.RemoveKeys(dictionary=code_block_86, keys=code_block_87)
code_block_88 = CodeBlock { "BoxClass_nonfixedclustered"; }
valueAtKey_35 = DesignScript.Builtin.Dictionary.ValueAtKey(dictionary=code_block_86, key=code_block_88)
code_block_89 = CodeBlock { "RotatedRectangle"; }
removeKeys_2 = DesignScript.Builtin.Dictionary.RemoveKeys(dictionary=valueAtKey_35, keys=code_block_89)
code_block_90 = CodeBlock { "BoxRotate"; }
valueAtKey_36 = DesignScript.Builtin.Dictionary.ValueAtKey(dictionary=valueAtKey_35, key=code_block_90)
code_block_91 = CodeBlock(i=valueAtKey_36) { i==1?true:false; }
code_block_92 = CodeBlock { "RotatedRectangle"; }
valueAtKey_37 = DesignScript.Builtin.Dictionary.ValueAtKey(dictionary=valueAtKey_35, key=code_block_92)
rotatedRectangle = CodeBlock(RotatedRectangle=valueAtKey_37) { RotatedRectangle; }
center_2 = Polygon.Center(polygon=rotatedRectangle)
ZAxis_3 = Vector.ZAxis()
code_block_93 = CodeBlock { "BldgBoundary"; }
valueAtKey_38 = DesignScript.Builtin.Dictionary.ValueAtKey(dictionary=code_block_86, key=code_block_93)
explode = Geometry.Explode(geometry=valueAtKey_38)
flatten_5 = List.Flatten(list=explode)
direction = Line.Direction(line=flatten_5)
length_2 = Vector.Length(vector=direction)
maximumItem = List.MaximumItem(list=length_2)
indexOf = List.IndexOf(list=length_2, element=maximumItem)
getItemAtIndex_16 = List.GetItemAtIndex(list=direction, index=indexOf)
normalized = Vector.Normalized(vector=getItemAtIndex_16)
X_5 = Vector.X(vector=normalized)
round_2 = Math.Round(number=X_5)
Y_5 = Vector.Y(vector=normalized)
round_3 = Math.Round(number=Y_5)
code_block_94 = CodeBlock(i=round_2, j=round_3) { i<0 || j<0?true:false; }
reverse = Vector.Reverse(vector=normalized)
if_2 = If(test=code_block_94, true=reverse, false=normalized)
explode_2 = Geometry.Explode(geometry=valueAtKey_37)
flatten_6 = List.Flatten(list=explode_2@L2)
direction_2 = Line.Direction(line=flatten_6)
length_3 = Vector.Length(vector=direction_2)
maximumItem_2 = List.MaximumItem(list=length_3)
indexOf_2 = List.IndexOf(list=length_3@L2, element=maximumItem_2@L1)
getItemAtIndex_17 = List.GetItemAtIndex(list=direction_2@L2, index=indexOf_2@L1)
normalized_2 = Vector.Normalized(vector=getItemAtIndex_17)
X_6 = Vector.X(vector=normalized_2)
round_4 = Math.Round(number=X_6)
Y_6 = Vector.Y(vector=normalized_2)
round_5 = Math.Round(number=Y_6)
code_block_95 = CodeBlock(i=round_4, j=round_5) { i<0 || j<0?true:false; }
reverse_2 = Vector.Reverse(vector=normalized_2)
if_3 = If(test=code_block_95, true=reverse_2, false=normalized_2)
angleWithVector = Vector.AngleWithVector(vector=if_2, otherVector=if_3)
round_6 = Math.Round(number=angleWithVector)
rotate_3 = Geometry.Rotate(geometry=rotatedRectangle, origin=center_2, axis=ZAxis_3, degrees=round_6)
if_4 = If(test=code_block_91, true=rotate_3, false=rotatedRectangle)
code_block_96 = CodeBlock(RotatedRectangle=if_4)  # same code as code_block_85
extendsChildDictionaryFromParent_7 = Custom[ExtendsChildDictionaryFromParent](ParentDic=removeKeys_2, ChildDic=code_block_96)
code_block_97 = CodeBlock(BoxClass_nonfixedclu=extendsChildDictionaryFromParent_7.dictionary)  # same code as code_block_74
extendsChildDictionaryFromParent_8 = Custom[ExtendsChildDictionaryFromParent](ParentDic=removeKeys, ChildDic=code_block_97)

# group: 클러스터링 사각형들 Zvalue 맞춰 층별배치하기
code_block_98 = CodeBlock(InputDic=extendsChildDictionaryFromParent_8.dictionary) { _InputDic; }
code_block_99 = CodeBlock { "BoxClass_nonfixedclustered"; }
removeKeys_3 = DesignScript.Builtin.Dictionary.RemoveKeys(dictionary=code_block_98, keys=code_block_99)
code_block_100 = CodeBlock { "BoxClass_nonfixedclustered"; }
valueAtKey_39 = DesignScript.Builtin.Dictionary.ValueAtKey(dictionary=code_block_98, key=code_block_100)
code_block_101 = CodeBlock { "RotatedRectangle"; }
removeKeys_4 = DesignScript.Builtin.Dictionary.RemoveKeys(dictionary=valueAtKey_39, keys=code_block_101)
code_block_102 = CodeBlock { "RotatedRectangle"; }
valueAtKey_40 = DesignScript.Builtin.Dictionary.ValueAtKey(dictionary=valueAtKey_39, key=code_block_102)
code_block_103 = CodeBlock { "BoxZvalue"; }
valueAtKey_41 = DesignScript.Builtin.Dictionary.ValueAtKey(dictionary=valueAtKey_39, key=code_block_103)
translate = Geometry.Translate(geometry=valueAtKey_40, zTranslation=valueAtKey_41)
code_block_104 = CodeBlock(RotatedRectangle=translate)  # same code as code_block_85
extendsChildDictionaryFromParent_9 = Custom[ExtendsChildDictionaryFromParent](ParentDic=removeKeys_4, ChildDic=code_block_104)
code_block_105 = CodeBlock(BoxClass_nonfixedclu=extendsChildDictionaryFromParent_9.dictionary)  # same code as code_block_74
extendsChildDictionaryFromParent_10 = Custom[ExtendsChildDictionaryFromParent](ParentDic=removeKeys_3, ChildDic=code_block_105)

# group: 사각형 Surfaces 흔들어 배치
code_block_106 = CodeBlock(InputDic=extendsChildDictionaryFromParent_10.dictionary) { _InputDic; }
code_block_107 = CodeBlock { "BoxClass_nonfixedclustered"; }
removeKeys_5 = DesignScript.Builtin.Dictionary.RemoveKeys(dictionary=code_block_106, keys=code_block_107)
code_block_108 = CodeBlock { "BoxClass_nonfixedclustered"; }
valueAtKey_42 = DesignScript.Builtin.Dictionary.ValueAtKey(dictionary=code_block_106, key=code_block_108)
code_block_109 = CodeBlock { "RotatedRectangle"; }
valueAtKey_43 = DesignScript.Builtin.Dictionary.ValueAtKey(dictionary=valueAtKey_42, key=code_block_109)
byPatch = Surface.ByPatch(closedCurve=valueAtKey_43)
code_block_110 = CodeBlock { "BldgBoundary"; }
valueAtKey_44 = DesignScript.Builtin.Dictionary.ValueAtKey(dictionary=code_block_106, key=code_block_110)
watch_4 = Watch(valueAtKey_44)
byPatch_2 = Surface.ByPatch(closedCurve=watch_4)
code_block_111 = CodeBlock { 0.5; }
pointAtParameter = Surface.PointAtParameter(surface=byPatch_2, u=code_block_111, v=code_block_111)
X_7 = Point.X(point=pointAtParameter)
Y_7 = Point.Y(point=pointAtParameter)
Z = Point.Z(point=pointAtParameter)
byOrigin = CoordinateSystem.ByOrigin(x=X_7, y=Y_7, z=Z)
explode_3 = Geometry.Explode(geometry=watch_4)
length_4 = Curve.Length(curve=explode_3)
maximumItem_3 = List.MaximumItem(list=length_4)
minimumItem = List.MinimumItem(list=length_4)
count_6 = List.Count(list=valueAtKey_43@L2)

watch_5 = Watch(byPatch)
code_block_112 = CodeBlock(a=watch_5) { a[0..1]; }
watch_6 = Watch(code_block_112)
code_block_113 = CodeBlock(a=watch_5) { a[2..4]; }
watch_7 = Watch(code_block_113)
flatten_7 = List.Flatten(list=watch_7)
list_create = List.Create(item0=flatten_7)
watch_8 = Watch(list_create)
code_block_114 = CodeBlock(a=watch_5) { a[5..6]; }
watch_9 = Watch(code_block_114)
join = List.Join(list0=watch_6, list1=watch_8, list2=watch_9)
watch_10 = Watch(join)

# group (continued): 사각형 Surfaces 흔들어 배치
shakeRoomSurfaces = Custom[ShakeRoomSurfaces](i=watch_10, CS=byOrigin, W=maximumItem_3, L=minimumItem)  # ShakeRoomSurfaces

watch_11 = Watch(shakeRoomSurfaces)
watch_12 = Watch(watch_11)
code_block_115 = CodeBlock(a=watch_12) { a[0..1]; }
watch_13 = Watch(code_block_115)
code_block_116 = CodeBlock(a=watch_12) { a[2]; }
watch_14 = Watch(code_block_116)
code_block_117 = CodeBlock { 1; }
chop = List.Chop(list=watch_14, lengths=code_block_117)
watch_15 = Watch(chop)
code_block_118 = CodeBlock(a=watch_12) { a[3..4]; }
watch_16 = Watch(code_block_118)
join_2 = List.Join(list0=watch_13, list1=watch_15, list2=watch_16)
watch_17 = Watch(join_2)
watch_18 = Watch(watch_17)
watch_19 = Watch(watch_18)
code_block_119 = CodeBlock { -2; }
dropItems_2 = List.DropItems(list=watch_19, amount=code_block_119)
code_block_120 = CodeBlock(a=watch_19) { a[5]; }
byJoinedSurfaces = PolySurface.ByJoinedSurfaces(surfaces=code_block_120)
watch_20 = Watch(byJoinedSurfaces)
perimeterCurves = Surface.PerimeterCurves(surface=code_block_120)
startPoint_2 = Curve.StartPoint(curve=perimeterCurves)
flatten_8 = List.Flatten(list=startPoint_2)
pruneDuplicates = Point.PruneDuplicates(points=flatten_8)
python_script = Python(IN[0]=pruneDuplicates)  # IronPython2
# ---------- python_script.python (55 lines) ----------
import clr
clr.AddReference('ProtoGeometry')
from Autodesk.DesignScript.Geometry import *

def ToVals(pt):
	return [pt.X,pt.Y,pt.Z]

def ToPts(ptVals):
	return Point.ByCoordinates(ptVals[0],ptVals[1],ptVals[2])

def CreateOutline(pts):
	crvs = []
	i = 0
	while i < len(pts):
		if i == len(pts)-1:
			crvs.append(Line.ByStartPointEndPoint(pts[i],pts[0]))
		else:
			crvs.append(Line.ByStartPointEndPoint(pts[i],pts[i+1]))
		i = i+1
	return PolyCurve.ByJoinedCurves(crvs)

'''
Taken from Thomas Switzers awesome GitHub repo and modified to suit Dynamo Context
https://gist.github.com/arthur-e/5cf52962341310f438e96c1f3c3398b8
I take zero credit for this work other than porting it across.
'''
def convex_hull_graham(points):
	'''
	Returns points on convex hull in CCW order according to Graham's scan algorithm. 
	By Tom Switzer <thomas.switzer@gmail.com>.
	'''
	TURN_LEFT, TURN_RIGHT, TURN_NONE = (1, -1, 0)

	def cmp(a, b):
		return (a > b) - (a < b)
	
	def turn(p, q, r):
		return cmp((q[0] - p[0])*(r[1] - p[1]) - (r[0] - p[0])*(q[1] - p[1]), 0)
	
	def _keep_left(hull, r):
		while len(hull) > 1 and turn(hull[-2], hull[-1], r) != TURN_LEFT:
			hull.pop()
		if not len(hull) or hull[-1] != r:
			hull.append(r)
		return hull

	points = [ToVals(p) for p in points]	
	points = sorted(points)
	l = reduce(_keep_left, points, [])
	u = reduce(_keep_left, reversed(points), [])
	points = l.extend(u[i] for i in range(1, len(u) - 1)) or l
	points = [ToPts(p) for p in points]
	return CreateOutline(points)

OUT = convex_hull_graham(IN[0])
# ----------------------------------------
byPatch_3 = Surface.ByPatch(closedCurve=python_script)
difference = Surface.Difference(surface=byPatch_3, others=byJoinedSurfaces)
count_7 = List.Count(list=difference)
code_block_121 = CodeBlock(a=count_7) { a>1; }
surfaces = PolySurface.Surfaces(polySurface=difference)
if_5 = If(test=code_block_121, true=surfaces, false=difference)
watch_21 = Watch(python_script)
code_block_122 = CodeBlock { -50; }
offset = Curve.Offset(curve=watch_21, distance=code_block_122)
code_block_123 = CodeBlock { 50; }
offset_2 = Curve.Offset(curve=watch_21, distance=code_block_123)
list_create_2 = List.Create(item0=offset, item1=offset_2)
flatten_9 = List.Flatten(list=list_create_2)
byLoft = Surface.ByLoft(crossSections=flatten_9)
code_block_124 = CodeBlock { 50; }
thicken = Surface.Thicken(surface=byLoft, thickness=code_block_124)
doesIntersect_2 = Geometry.DoesIntersect(geometry=thicken, other=if_5, lacing=Longest)
filterByBoolMask_2 = List.FilterByBoolMask(list=if_5, mask=doesIntersect_2)
flatten_10 = List.Flatten(list=filterByBoolMask_2.in)
perimeterCurves_2 = Surface.PerimeterCurves(surface=flatten_10)
startPoint_3 = Curve.StartPoint(curve=perimeterCurves_2)
flatten_11 = List.Flatten(list=startPoint_3)
code_block_125 = CodeBlock { 1; }
pruneDuplicates_2 = Point.PruneDuplicates(points=flatten_11, tolerance=code_block_125)
doesIntersect_3 = Geometry.DoesIntersect(geometry=thicken, other=pruneDuplicates_2)
filterByBoolMask_3 = List.FilterByBoolMask(list=pruneDuplicates_2, mask=doesIntersect_3)
watch_22 = Watch(filterByBoolMask_3.in)
flatten_12 = List.Flatten(list=watch_22)
firstItem_3 = List.FirstItem(list=flatten_12)
ZAxis_4 = Vector.ZAxis()
code_block_126 = CodeBlock { 0..270..90; }
rotate_4 = Geometry.Rotate(geometry=watch_20, origin=firstItem_3, axis=ZAxis_4, degrees=code_block_126)
code_block_127 = CodeBlock(a=watch_19) { a[6]; }
python_script_20210913 = Python(IN[0]=code_block_127)  # CPython3; unwired: IN[1]
# ---------- python_script_20210913.python (198 lines) ----------
# Load the Python Standard and DesignScript Libraries
from random import randint
import sys
import clr
clr.AddReference('ProtoGeometry')
from Autodesk.DesignScript.Geometry import *
clr.AddReference('DSCoreNodes')
from DSCore import *
from DSCore import Color
clr.AddReference('GeometryColor')
from Modifiers import GeometryColor
from functools import reduce

# The inputs to this node will be stored as a list in the IN variables.
##############################
dataEnteringNode = IN
InList = IN[0]
PlacingBoundary = IN[1]

PrePlacingList = []
PostPlacingList = []

###########################################################################
class FuncCurrying:
    pass

class ConvexHull_Maker:
    def __init__(self, points):
        def convex_hull_graham(points):
            def ToVals(pt):
	            return [pt.X,pt.Y,pt.Z]
            def ToPts(ptVals):
	            return Point.ByCoordinates(ptVals[0],ptVals[1],ptVals[2])
	           
            def CreateOutline(pts):
                crvs = []
                i = 0
                while i < len(pts):
                    if i == len(pts)-1:
                        crvs.append(Line.ByStartPointEndPoint(pts[i],pts[0]))
                    else:
                        crvs.append(Line.ByStartPointEndPoint(pts[i],pts[i+1]))
                    i = i+1
                return PolyCurve.ByJoinedCurves(crvs)
	
            TURN_LEFT, TURN_RIGHT, TURN_NONE = (1, -1, 0)

            def cmp(a, b):
                return (a > b) - (a < b)
	
            def turn(p, q, r):
                return cmp((q[0] - p[0])*(r[1] - p[1]) - (r[0] - p[0])*(q[1] - p[1]), 0)
	
            def _keep_left(hull, r):
                while len(hull) > 1 and turn(hull[-2], hull[-1], r) != TURN_LEFT:
                    hull.pop()
                if not len(hull) or hull[-1] != r:
                    hull.append(r)
                return hull

            points = [ToVals(p) for p in points]	
            points = sorted(points)
            l = reduce(_keep_left, points, [])
            u = reduce(_keep_left, reversed(points), [])
            points = l.extend(u[i] for i in range(1, len(u) - 1)) or l
            points = [ToPts(p) for p in points]
            return CreateOutline(points)
            
        self.points = points
        result = convex_hull_graham(points)
        self.result = result

class Qluster:
    def __init__(self, cl):
        def create_joinedSrf(cl):
            return PolySurface.ByJoinedSurfaces(cl)
        def find_periCrvsOn_srf(srf):
            return srf.PerimeterCurves()
        def get_PointOf_PeriCrvs(crvs):
            return list(map(lambda x: x.StartPoint,crvs))
        def get_cvxHullFor_cl(cl):
            return ConvexHull_Maker(cl).result
        def create_offsetCrv(crv, offset):
            return Curve.Offset(crv, offset)
        def create_bdrySolid_forInsp(pcrv):
            offin_cvx_crv = Curve.Offset(pcrv,-10)
            offout_cvx_crv = Curve.Offset(pcrv,300)
            cvx_bdry_srf = Surface.ByLoft([offout_cvx_crv, offin_cvx_crv])
            cvx_bdry_solid = Surface.Thicken(cvx_bdry_srf, 1, True)
            return cvx_bdry_solid
        def patch_pCrv(pcrv):
            return Surface.ByPatch(pcrv)
        def find_boundary_point(cl):
            pass
            
        self.cl = cl
        
        psrf = create_joinedSrf(cl)
        self.psrf = psrf
        
        crvs = find_periCrvsOn_srf(psrf)
        self.crvs = crvs
        
        startpt_crv = get_PointOf_PeriCrvs(crvs)
        self.startpt_crv = startpt_crv
        
        crv_cvxHull = get_cvxHullFor_cl(startpt_crv)
        self.crv_cvxHull = crv_cvxHull
        
        crv_cvxHull_offin = create_offsetCrv(crv_cvxHull, -10)
        bdrysolid_cvxHull = create_bdrySolid_forInsp(crv_cvxHull)
        self.bdrysolid_cvxHull = bdrysolid_cvxHull
        
        patched_cvxHull = patch_pCrv(crv_cvxHull)

        try:
            diff_srf = Surface.Difference(patched_cvxHull, cl)
            if isinstance(diff_srf, PolySurface):
                div_diff_srflist = PolySurface.Surfaces(diff_srf)
            else:
                div_diff_srflist = [diff_srf]
        except:
            div_diff_srflist = [patched_cvxHull]
        self.div_diff_srflist = div_diff_srflist
        
        outer_srf_diff = list(
        filter(lambda x: Geometry.DoesIntersect(x, bdrysolid_cvxHull), div_diff_srflist))
        self.outer_srf_diff = outer_srf_diff
        inner_srf_diff = list(
        filter(lambda x: Geometry.DoesIntersect(x, bdrysolid_cvxHull) == False, div_diff_srflist))
        if len(inner_srf_diff) == 0:
            pt_cl_bdry = startpt_crv
        else:
            joined_inner_srf = PolySurface.ByJoinedSurfaces(inner_srf_diff)
            pre_pt_cl_bdry = list(
            filter(lambda x: Geometry.DoesIntersect(x, joined_inner_srf) == False, startpt_crv))
            pt_cl_bdry = list(
            filter(lambda x: Geometry.DoesIntersect(x, patch_pCrv(crv_cvxHull_offin)) == False, pre_pt_cl_bdry))
        crvlist_outer_srf = list(map(find_periCrvsOn_srf, outer_srf_diff))
        pt_outer_srf = sum(list(map(get_PointOf_PeriCrvs, crvlist_outer_srf)),[])
        self.pt_outer_srf = pt_outer_srf
        pt_cvx_bdry = list(filter(lambda x: Geometry.DoesIntersect(x, bdrysolid_cvxHull), pt_outer_srf))
 
        preip = list(filter(lambda x: Geometry.DoesIntersect(x, bdrysolid_cvxHull) != True, pt_outer_srf))
        
        def f_nip(x):
            return filter(lambda y: Geometry.DoesIntersect(x, y) == False, cir_ip)

        if len(preip) == 0:
            minX = min(map(lambda x: round(x.X,3), pt_outer_srf))
            maxY = max(map(lambda x: round(x.Y,3), pt_outer_srf))
            pt_X = list(filter(lambda x: round(x.X,3) == minX, pt_outer_srf))
            ip = list(filter(lambda x: round(x.Y,3) == maxY, pt_X))
            cir_ip = list(map(lambda x: Sphere.ByCenterPointRadius(x,1), ip))
            uni_cir_ip = Solid.ByUnion(cir_ip)
            nip = list(filter(lambda x: Geometry.DoesIntersect(x, uni_cir_ip) == False, pt_cl_bdry))
        else:
            ip = list(filter(lambda x: Geometry.DoesIntersect(x, bdrysolid_cvxHull) != True, pt_outer_srf))
            cir_ip = list(map(lambda x: Sphere.ByCenterPointRadius(x,1), ip))
            uni_cir_ip = Solid.ByUnion(cir_ip)
            nip = list(filter(lambda x: Geometry.DoesIntersect(x, uni_cir_ip) == False, pt_cl_bdry))
        self.cir_ip = cir_ip
        self.ip = ip
        self.nip = nip
        qcircle_ip = list(map(lambda x: Sphere.ByCenterPointRadius(x,500), ip))
        self.qcircle_ip = qcircle_ip
        qcircle_nip = list(map(lambda x: Sphere.ByCenterPointRadius(x,500), nip))
        self.qcircle_nip = qcircle_nip

class Qplacer: ## clst: cluster set, cl: cluster, clem: cluster elements
    pass



# Place your code below this line
def colorize(i,r,g,b):
	return GeometryColor.ByGeometryColor(i, Color.ByARGB(125, r, g, b))


a = Qluster(InList).cl
b = Qluster(InList).crvs
c = Qluster(InList).startpt_crv
d = Qluster(InList).crv_cvxHull
e = colorize(Qluster(InList).bdrysolid_cvxHull, 255,0,0)
f = list(map(lambda x: colorize(x,0,125,0),Qluster(InList).qcircle_ip))
g = Qluster(InList).pt_outer_srf
h = Qluster(InList).ip
i = list(map(lambda x: colorize(x,0,0,125),Qluster(InList).qcircle_nip))
#b = Qluster(InList).startpt_crv
#c = Qluster(InList).crv_convexhull_clst
#d = []
#for i in ClusterComplex(InList).bdrysolid_convexhull_clst:
#    d.append(GeometryColor.ByGeometryColor(i, Color.ByARGB(125, 255, 0, 0)))
#d = list(map(lambda i: f_vision(i,255,0,0), Qluster(InList).bdrysolid_convexhull_clst))
#f = ClusterComplex(InList).crvs
#f = list(map(lambda i: f_vision(i,125,0,0),ClusterComplex(InList).bdrysolid_peri_clst))
# Assign your output to the OUT variable.
OUT = (b,d,e,f,h,i)
# ----------------------------------------
watch_23 = Watch(python_script_20210913)
code_block_128 = CodeBlock(a=watch_23) { a[4]; }
flatten_13 = List.Flatten(list=code_block_128)
byTwoPoints = Vector.ByTwoPoints(start=firstItem_3, end=flatten_13)
translate_2 = Geometry.Translate(geometry=rotate_4@L2, direction=byTwoPoints, lacing=Longest)
flatten_14 = List.Flatten(list=translate_2)
byJoinedSurfaces_2 = PolySurface.ByJoinedSurfaces(surfaces=code_block_127)
watch_24 = Watch(byJoinedSurfaces_2)
thicken_2 = Surface.Thicken(surface=watch_24)
thicken_3 = Surface.Thicken(surface=flatten_14)
intersect = Geometry.Intersect(geometry=thicken_2, other=thicken_3)
count_8 = List.Count(list=intersect@L2)
code_block_129 = CodeBlock(a=count_8) { a>1; }
filterByBoolMask_4 = List.FilterByBoolMask(list=flatten_14, mask=code_block_129)
flatten_15 = List.Flatten(list=filterByBoolMask_4.in)
lastItem = List.LastItem(list=flatten_12)
ZAxis_5 = Vector.ZAxis()
code_block_130 = CodeBlock { 0..270..90; }
rotate_5 = Geometry.Rotate(geometry=watch_20, origin=lastItem, axis=ZAxis_5, degrees=code_block_130)
byTwoPoints_2 = Vector.ByTwoPoints(start=lastItem, end=flatten_13)
translate_3 = Geometry.Translate(geometry=rotate_5@L2, direction=byTwoPoints_2, lacing=Longest)
flatten_16 = List.Flatten(list=translate_3)
watch_25 = Watch(byJoinedSurfaces_2)
thicken_4 = Surface.Thicken(surface=watch_25)
thicken_5 = Surface.Thicken(surface=flatten_16)
intersect_2 = Geometry.Intersect(geometry=thicken_4, other=thicken_5)
count_9 = List.Count(list=intersect_2@L2)
code_block_131 = CodeBlock(a=count_9) { a>1; }
filterByBoolMask_5 = List.FilterByBoolMask(list=flatten_16, mask=code_block_131)
flatten_17 = List.Flatten(list=filterByBoolMask_5.in)
join_3 = List.Join(list0=flatten_15, list1=flatten_17)
watch_26 = Watch(watch_4)
byPatch_4 = Surface.ByPatch(closedCurve=watch_26)
code_block_132 = CodeBlock { 50000; }
thicken_6 = Surface.Thicken(surface=byPatch_4, thickness=code_block_132)
intersect_3 = Geometry.Intersect(geometry=thicken_6, other=join_3, lacing=Longest)
area = Surface.Area(surface=intersect_3)
sum = Math.Sum(values=area)
maximumItem_4 = List.MaximumItem(list=sum)
eq = maximumItem_4 == sum
filterByBoolMask_6 = List.FilterByBoolMask(list=join_3, mask=eq)
flatten_18 = List.Flatten(list=filterByBoolMask_6.in)
explode_4 = Geometry.Explode(geometry=flatten_18)
flatten_19 = List.Flatten(list=explode_4)
watch_27 = Watch(flatten_19)
list_create_3 = List.Create(item0=watch_27)
watch_28 = Watch(code_block_127)
list_create_4 = List.Create(item0=watch_28)
join_4 = List.Join(list0=dropItems_2, list1=list_create_3, list2=list_create_4)

# group (continued): 사각형 Surfaces 흔들어 배치
flatten_20 = List.Flatten(list=join_4)
chop_2 = List.Chop(list=flatten_20, lengths=count_6)
code_block_133 = CodeBlock(ShakedSurfaces=chop_2)
# ---------- code_block_133.designscript (3 lines) ----------
{
"ShakedSurfaces": _ShakedSurfaces
};
# ----------------------------------------
extendsChildDictionaryFromParent_11 = Custom[ExtendsChildDictionaryFromParent](ParentDic=valueAtKey_42, ChildDic=code_block_133)
code_block_134 = CodeBlock(BoxClass_nonfixedclu=extendsChildDictionaryFromParent_11.dictionary)  # same code as code_block_74
extendsChildDictionaryFromParent_12 = Custom[ExtendsChildDictionaryFromParent](ParentDic=removeKeys_5, ChildDic=code_block_134)

color_palette = ColorPalette({R: 255, G: 215, B: 0, A: 150})
color_palette_2 = ColorPalette({R: 220, G: 20, B: 60, A: 150})
color_palette_3 = ColorPalette({R: 70, G: 130, B: 180, A: 150})
color_palette_4 = ColorPalette({R: 238, G: 130, B: 238, A: 150})
color_palette_5 = ColorPalette({R: 50, G: 205, B: 50, A: 150})
color_palette_6 = ColorPalette({R: 255, G: 127, B: 80, A: 150})
list_create_5 = List.Create(item0=color_palette, item1=color_palette_2, item2=color_palette_3, item3=color_palette_4, item4=color_palette_5, item5=color_palette_6)

# group: 부서별 색상 지정
code_block_135 = CodeBlock()
# ---------- code_block_135.designscript (6 lines) ----------
color1 = Color.ByARGB(150, 200, 0, 0);
color2 = Color.ByARGB(150, 0, 200, 0);
color3 = Color.ByARGB(150, 0, 0, 200);
color4 = Color.ByARGB(200, 0, 0, 200);
color5 = Color.ByARGB(200, 200, 0, 100);
color6 = Color.ByARGB(200, 0, 200, 0);
# ----------------------------------------
remember_3 = Data.Remember(code_block_135.color4)
remember_4 = Data.Remember(code_block_135.color5)
remember_5 = Data.Remember(code_block_135.color1)
remember_6 = Data.Remember(code_block_135.color2)
remember_7 = Data.Remember(code_block_135.color3)
join_5 = List.Join(list0=remember_5, list1=remember_6, list2=remember_7)
remember_8 = Data.Remember(code_block_135.color6)
code_block_136 = CodeBlock(InputDic=extendsChildDictionaryFromParent_12.dictionary) { _InputDic; }
code_block_137 = CodeBlock { "BoxClass_nonfixedclustered"; }
valueAtKey_45 = DesignScript.Builtin.Dictionary.ValueAtKey(dictionary=code_block_136, key=code_block_137)
code_block_138 = CodeBlock { "BoxDepartment"; }
valueAtKey_46 = DesignScript.Builtin.Dictionary.ValueAtKey(dictionary=valueAtKey_45, key=code_block_138)
watch_29 = Watch(valueAtKey_46)
uniqueItems_4 = List.UniqueItems(list=watch_29)
flatten_21 = List.Flatten(list=uniqueItems_4)
byKeysValues_3 = DesignScript.Builtin.Dictionary.ByKeysValues(keys=flatten_21, values=list_create_5)
code_block_139 = CodeBlock(DepartmentColorDic=byKeysValues_3)
# ---------- code_block_139.designscript (3 lines) ----------
{
"DepartmentColorDic": _DepartmentColorDic
};
# ----------------------------------------
extendsChildDictionaryFromParent_13 = Custom[ExtendsChildDictionaryFromParent](ParentDic=code_block_136, ChildDic=code_block_139)

code_block_140 = CodeBlock { "BoxClass_nonfixedclustered"; }
code_block_141 = CodeBlock { "ShakedSurfaces"; }

# group: 사각 공간 색상 지정
code_block_142 = CodeBlock(InputDic=extendsChildDictionaryFromParent_13.dictionary) { _InputDic; }
code_block_143 = CodeBlock { "BoxHeight"; }
boolean_2 = BoolSelector(false)
code_block_144 = CodeBlock { "DepartmentColorDic"; }
valueAtKey_47 = DesignScript.Builtin.Dictionary.ValueAtKey(dictionary=code_block_142, key=code_block_144)
code_block_145 = CodeBlock { "BoxDepartment"; }
code_block_146 = CodeBlock { "BoxSpaceID"; }

valueAtKey_48 = DesignScript.Builtin.Dictionary.ValueAtKey(dictionary=code_block_142, key=code_block_140)

# group (continued): 사각 공간 색상 지정
valueAtKey_49 = DesignScript.Builtin.Dictionary.ValueAtKey(dictionary=valueAtKey_48, key=code_block_141)
valueAtKey_50 = DesignScript.Builtin.Dictionary.ValueAtKey(dictionary=valueAtKey_48, key=code_block_143)
thicken_7 = Surface.Thicken(surface=valueAtKey_49, thickness=valueAtKey_50, both_sides=boolean_2)
valueAtKey_51 = DesignScript.Builtin.Dictionary.ValueAtKey(dictionary=valueAtKey_48, key=code_block_145)
valueAtKey_52 = DesignScript.Builtin.Dictionary.ValueAtKey(dictionary=valueAtKey_48, key=code_block_146)
flatten_22 = List.Flatten(list=valueAtKey_52)
code_block_147 = CodeBlock(RoomSolid=thicken_7)
# ---------- code_block_147.designscript (3 lines) ----------
{
"RoomSolid": _RoomSolid
};
# ----------------------------------------
extendsChildDictionaryFromParent_14 = Custom[ExtendsChildDictionaryFromParent](ParentDic=code_block_142, ChildDic=code_block_147)

flatten_23 = List.Flatten(list=valueAtKey_51)

# group (continued): 사각 공간 색상 지정
valueAtKey_53 = DesignScript.Builtin.Dictionary.ValueAtKey(dictionary=valueAtKey_47, key=flatten_23)
byGeometryColor = Modifiers.GeometryColor.ByGeometryColor(geometry=thicken_7, color=valueAtKey_53)
getItemAtIndex_18 = List.GetItemAtIndex(list=flatten_23, index=flatten_22)

watch_30 = Watch(extendsChildDictionaryFromParent_12.dictionary)
origin = Point.Origin()
origin_2 = Point.Origin()
watch_31 = Watch(filterByBoolMask_3.out)
flatten_24 = List.Flatten(list=watch_31)
code_block_148 = CodeBlock { 1000; }
code_block_149 = CodeBlock(a=maximumItem_4) { a/1000000; }
output_area = Math.Round(number=code_block_149)  # graph output

# group: GD Output - difference area to minimum
code_block_150 = CodeBlock(InputDic=extendsChildDictionaryFromParent_14.dictionary) { _InputDic; }
code_block_151 = CodeBlock { "ShakedSurfaces"; }
code_block_152 = CodeBlock { "BoxZvalue"; }
code_block_153 = CodeBlock { "BldgBoundary"; }
valueAtKey_54 = DesignScript.Builtin.Dictionary.ValueAtKey(dictionary=code_block_150, key=code_block_153)
basePlane = PolyCurve.BasePlane(polyCurve=valueAtKey_54)
firstItem_4 = List.FirstItem(list=basePlane)
code_block_154 = CodeBlock { 1; }
code_block_155 = CodeBlock { 10; }
offset_3 = Curve.Offset(curve=valueAtKey_54, distance=code_block_155)

code_block_156 = CodeBlock { "BoxClass_nonfixedclustered"; }
valueAtKey_55 = DesignScript.Builtin.Dictionary.ValueAtKey(dictionary=code_block_150, key=code_block_156)

# group (continued): GD Output - difference area to minimum
valueAtKey_56 = DesignScript.Builtin.Dictionary.ValueAtKey(dictionary=valueAtKey_55, key=code_block_151)
flatten_25 = List.Flatten(list=valueAtKey_56)
valueAtKey_57 = DesignScript.Builtin.Dictionary.ValueAtKey(dictionary=valueAtKey_55, key=code_block_152)
flatten_26 = List.Flatten(list=valueAtKey_57)
uniqueItems_5 = List.UniqueItems(list=flatten_26)
allIndicesOf_2 = List.AllIndicesOf(list=flatten_26, item=uniqueItems_5)

perimeterCurves_3 = Surface.PerimeterCurves(surface=flatten_25)
byJoinedCurves_2 = PolyCurve.ByJoinedCurves(curves=perimeterCurves_3)
flatten_27 = List.Flatten(list=allIndicesOf_2)

# group (continued): GD Output - difference area to minimum
getItemAtIndex_19 = List.GetItemAtIndex(list=byJoinedCurves_2, index=flatten_27)
pullOntoPlane = Curve.PullOntoPlane(curve=getItemAtIndex_19, plane=firstItem_4)
byPatch_5 = Surface.ByPatch(closedCurve=pullOntoPlane)
split = Geometry.Split(geometry=byPatch_5, other=valueAtKey_54, lacing=CrossProduct)
flatten_28 = List.Flatten(list=split@L2, amt=code_block_154)
flatten_29 = List.Flatten(list=flatten_28)
doesIntersect_4 = Geometry.DoesIntersect(geometry=flatten_29@L2, other=offset_3@L1)
flatten_30 = List.Flatten(list=doesIntersect_4)
filterByBoolMask_7 = List.FilterByBoolMask(list=flatten_29, mask=flatten_30)
area_2 = Surface.Area(surface=filterByBoolMask_7.in)
math_sum_outside_area_of = Math.Sum(values=area_2)  # "Math.Sum@Outside Area of Boundary"

code_block_157 = CodeBlock(a=math_sum_outside_area_of) { a/1000000; }
outside_area_of_boundary = Math.Round(number=code_block_157)  # graph output
explode_5 = Geometry.Explode(geometry=thicken_7)
perimeterCurves_4 = Surface.PerimeterCurves(surface=explode_5)
code_block_158 = CodeBlock { "BoxClass_fixedpart"; }
valueAtKey_58 = DesignScript.Builtin.Dictionary.ValueAtKey(dictionary=code_block_142, key=code_block_158)
code_block_159 = CodeBlock { "BoxGeometry"; }
valueAtKey_59 = DesignScript.Builtin.Dictionary.ValueAtKey(dictionary=valueAtKey_58, key=code_block_159)
explode_6 = Geometry.Explode(geometry=valueAtKey_59)
perimeterCurves_5 = Surface.PerimeterCurves(surface=explode_6)
code_block_160 = CodeBlock(i=thicken_7) { i; }
centroid_2 = Solid.Centroid(solid=code_block_160)
byPoint = FamilyInstance.ByPoint()  # unwired: familyType, point

# group: On Test
python_script_2 = Python(IN[0]=shakeRoomSurfaces, IN[1]=watch_4)  # CPython3
# ---------- python_script_2.python (372 lines) ----------
# Load the Python Standard and DesignScript Libraries
from random import randint
import sys
import clr
clr.AddReference('ProtoGeometry')
from Autodesk.DesignScript.Geometry import *
clr.AddReference('DSCoreNodes')
from DSCore import *
from DSCore import Color
clr.AddReference('GeometryColor')
from Modifiers import GeometryColor
from functools import reduce
import itertools
import operator


# The inputs to this node will be stored as a list in the IN variables.
##############################
dataEnteringNode = IN
InList = IN[0]
PlacingBoundary = IN[1]
pBdry_crvs = PolyCurve.Curves(PlacingBoundary[0])
pBdry_pts = list(map(lambda x: x.StartPoint,pBdry_crvs))
PrePlacingList = []
PostPlacingList = []

###########################################################################

class ConvexHull_Maker:
    def __init__(self, points):
        def convex_hull_graham(points):
            def ToVals(pt):
	            return [pt.X,pt.Y,pt.Z]
            def ToPts(ptVals):
	            return Point.ByCoordinates(ptVals[0],ptVals[1],ptVals[2])
	           
            def CreateOutline(pts):
                crvs = []
                i = 0
                while i < len(pts):
                    if i == len(pts)-1:
                        crvs.append(Line.ByStartPointEndPoint(pts[i],pts[0]))
                    else:
                        crvs.append(Line.ByStartPointEndPoint(pts[i],pts[i+1]))
                    i = i+1
                return PolyCurve.ByJoinedCurves(crvs)
	
            TURN_LEFT, TURN_RIGHT, TURN_NONE = (1, -1, 0)

            def cmp(a, b):
                return (a > b) - (a < b)
	
            def turn(p, q, r):
                return cmp((q[0] - p[0])*(r[1] - p[1]) - (r[0] - p[0])*(q[1] - p[1]), 0)
	
            def _keep_left(hull, r):
                while len(hull) > 1 and turn(hull[-2], hull[-1], r) != TURN_LEFT:
                    hull.pop()
                if not len(hull) or hull[-1] != r:
                    hull.append(r)
                return hull

            points = [ToVals(p) for p in points]	
            points = sorted(points)
            l = reduce(_keep_left, points, [])
            u = reduce(_keep_left, reversed(points), [])
            points = l.extend(u[i] for i in range(1, len(u) - 1)) or l
            points = [ToPts(p) for p in points]
            return CreateOutline(points)
            
        self.points = points
        result = convex_hull_graham(points)
        self.result = result

class Qluster:
    def __init__(self, srfs_rooms):
        def create_clusterSrf(srfs):
            return PolySurface.ByJoinedSurfaces(srfs)
        def find_periCrvsOn_srf(psrf):
            return psrf.PerimeterCurves()
        def get_PointOf_PeriCrvs(crvs):
            return list(map(lambda x: x.StartPoint,crvs))
        def get_cvxHull(pts):
            return ConvexHull_Maker(pts).result
        def create_offsetCrv(pcrv, offset):
            return Curve.Offset(pcrv, offset)
        def create_bdrySolid_forInsp(pcrv):
            Crv_offin = Curve.Offset(pcrv,-10)
            Crv_offout = Curve.Offset(pcrv,300)
            srf_on2crv = Surface.ByLoft([Crv_offout, Crv_offin])
            solid_on2crv = Surface.Thicken(srf_on2crv, 1, True)
            return solid_on2crv
        def patch_pCrv(pcrv):
            return Surface.ByPatch(pcrv)
            
        self.srfs_rooms = srfs_rooms
        
        psrf_cluster = create_clusterSrf(srfs_rooms)
        self.psrf_cluster = psrf_cluster
        
        level_cluster = BoundingBox.ByGeometry(psrf_cluster).MaxPoint.Z
        self.level_cluster = level_cluster
        
        crvs_cluster = find_periCrvsOn_srf(psrf_cluster)
        self.crvs_cluster = crvs_cluster
        
        pts_cluster = get_PointOf_PeriCrvs(crvs_cluster)
        self.pts_cluster = pts_cluster
        
        cvxCrv_cluster = get_cvxHull(pts_cluster)
        self.cvxCrv_cluster = cvxCrv_cluster
        
        cvxCrv_offin = create_offsetCrv(cvxCrv_cluster, -10)
        solid_cvxHull = create_bdrySolid_forInsp(cvxCrv_cluster)
        self.solid_cvxHull = solid_cvxHull
        
        patched_cvxCrv_offin = patch_pCrv(cvxCrv_offin)

        try:
            diff_srf = Surface.Difference(patched_cvxCrv_offin, srfs_rooms)
            if isinstance(diff_srf, PolySurface):
                div_diff_srflist = PolySurface.Surfaces(diff_srf)
            else:
                div_diff_srflist = [diff_srf]
        except:
            div_diff_srflist = [patched_cvxCrv_offin]
        self.div_diff_srflist = div_diff_srflist
        
        outer_srf_diff = list(filter(lambda x: Geometry.DoesIntersect(x, solid_cvxHull), div_diff_srflist))
        self.outer_srf_diff = outer_srf_diff
        inner_srf_diff = list(
        filter(lambda x: Geometry.DoesIntersect(x, solid_cvxHull) == False, div_diff_srflist))
        if len(inner_srf_diff) == 0:
            pt_cl_bdry = pts_cluster
        else:
            joined_inner_srf = PolySurface.ByJoinedSurfaces(inner_srf_diff)
            pre_pt_cl_bdry = list(
            filter(lambda x: Geometry.DoesIntersect(x, joined_inner_srf) == False, pts_cluster))
            pt_cl_bdry = list(
            filter(lambda x: Geometry.DoesIntersect(x, patch_pCrv(cvxCrv_offin)) == False, pre_pt_cl_bdry))
        crvlist_outer_srf = list(map(find_periCrvsOn_srf, outer_srf_diff))
        pt_outer_srf = sum(list(map(get_PointOf_PeriCrvs, crvlist_outer_srf)),[])
        self.pt_outer_srf = pt_outer_srf
        pt_cvx_bdry = list(filter(lambda x: Geometry.DoesIntersect(x, solid_cvxHull), pt_outer_srf))
 
        preip = list(filter(lambda x: Geometry.DoesIntersect(x, solid_cvxHull) != True, pt_outer_srf))
        
        def f_nip(x):
            return filter(lambda y: Geometry.DoesIntersect(x, y) == False, cir_ip)

        if len(preip) == 0:
            minX = min(map(lambda x: round(x.X,3), pt_outer_srf))
            maxY = max(map(lambda x: round(x.Y,3), pt_outer_srf))
            pt_X = list(filter(lambda x: round(x.X,3) == minX, pt_outer_srf))
            ip = list(filter(lambda x: round(x.Y,3) == maxY, pt_X))
            cir_ip = list(map(lambda x: Sphere.ByCenterPointRadius(x,1), ip))
            uni_cir_ip = Solid.ByUnion(cir_ip)
            nip = list(filter(lambda x: Geometry.DoesIntersect(x, uni_cir_ip) == False, pt_cl_bdry))
        else:
            ip = list(filter(lambda x: Geometry.DoesIntersect(x, solid_cvxHull) != True, pt_outer_srf))
            cir_ip = list(map(lambda x: Sphere.ByCenterPointRadius(x,1), ip))
            uni_cir_ip = Solid.ByUnion(cir_ip)
            nip = list(filter(lambda x: Geometry.DoesIntersect(x, uni_cir_ip) == False, pt_cl_bdry))
        self.cir_ip = cir_ip
        self.ip = ip
        self.nip = nip
        qcircle_ip = list(map(lambda x: Sphere.ByCenterPointRadius(x,500), ip))
        self.qcircle_ip = qcircle_ip
        qcircle_nip = list(map(lambda x: Sphere.ByCenterPointRadius(x,500), nip))
        self.qcircle_nip = qcircle_nip
        
    def translate(self, vec):
        self.srfs_rooms = list(map(lambda x: Geometry.Translate(x, vec), self.srfs_rooms))
        self.psrf_cluster = Geometry.Translate(self.psrf_cluster, vec)
        self.ip = list(map(lambda x: Geometry.Translate(x, vec), self.ip))
        self.nip = list(map(lambda x: Geometry.Translate(x, vec), self.nip))
        
    def create_rotationlist_nip(self, origin):
        degreelist = [0, 90, 180, 270]
        return list(map(lambda x: Geometry.Rotate(self.psrf_cluster, origin, Vector.ZAxis(), x), degreelist))

### 층별로 클러스터 set 만드는 클래스? 혹은 기능 구간 삽입 필요###
class QlusterSetByLevel:
    def __init__(self, srfs_totalrooms):
        data = list(map(lambda x: {'obj': Qluster(x), 'level': str(Qluster(x).level_cluster)}, srfs_totalrooms))
        grouped_data = itertools.groupby(data, key=operator.itemgetter('level'))
        self.grouped_data = grouped_data
        tmp = {}
        for key, i in grouped_data:
            tmp[key] = list(i)
        keys = list(tmp.keys())
        self.keys = keys
        result = list(map(lambda x: tmp.get(x), keys))
        self.result = result
        Qset = list(
                map(lambda x: list(
                    map(lambda i: i.get('obj'),x)), result))
        self.Qset = Qset
    pass

class QsetPlacer:
    def __init__(self, qset, placingBdry):
        self.qset = qset
        
        crvs_placingBdry = PolyCurve.Curves(placingBdry[0])
        pts_placingBdry = list(map(lambda x: x.StartPoint,pBdry_crvs))
        pcrv_offin = Curve.Offset(placingBdry[0], -1)
        solid_placingBdry = Surface.ByPatch(pcrv_offin).Thicken(100000, True)
        
        srf_cluster = list(map(lambda x: x.srfs_rooms, qset))
        self.srf_cluster = srf_cluster
        
        level_qluster = list(map(lambda x: x.level_cluster, qset))
        self.level_qluster = level_qluster
        
        qluster_ip = list(map(lambda x: x.ip, qset))
        self.qluster_ip = qluster_ip
        
        qluster_nip = list(map(lambda x: x.nip, qset))
        self.qluster_nip = qluster_nip
        
        qcircle_ip = list(map(lambda x: x.qcircle_ip, qset))
        self.qcircle_ip = qcircle_ip
        
        stdPt_placingBdry = placingBdry[0].PointAtParameter(0)
        self.stdPt_placingBdry = stdPt_placingBdry
        
        postPlacinglist = []
        self.postPlacinglist = postPlacinglist
        
        postIPlist = []
        self.postIPlist = postIPlist
        

        def create_rotationlist(srf, origin):
            degreelist = [0, 90, 180, 270]
            return list(map(lambda x: Geometry.Rotate(srf, origin, Vector.ZAxis(), x), degreelist))

        def place_init(qluster, solid_placingBdry):
            startPts = qluster.nip
            endPt = Point.ByCoordinates(stdPt_placingBdry.X, stdPt_placingBdry.Y, qluster.level_cluster)
            
            possibleSrfs = []
            for startPt in startPts:
                dirVec = Vector.ByTwoPoints(startPt, endPt)
                psrf_cluster = qluster.psrf_cluster
                psrfs_cluster_rotate = create_rotationlist(psrf_cluster, startPt)
                psrfs_cluster_rotate_tr = list(map(lambda x: Geometry.Translate(x, dirVec), psrfs_cluster_rotate))
                possibleSrfs.extend(list(filter(lambda x: x.DoesIntersect(solid_placingBdry), psrfs_cluster_rotate_tr)))
            
            dic = {}
            for i in possibleSrfs:
                geo_intsct = i.Intersect(solid_placingBdry)
                area_polysrf_intsct = PolySurface.ByJoinedSurfaces(list(geo_intsct)).Area
                dic[area_polysrf_intsct] = i
            result = dic.get(max(list(dic.keys())))
            return result
            
            
        def place_next(qluster, solid_placingBdry, postPlacinglist):
            startPts = qluster.ip
            psrf_postPlacinglist = PolySurface.ByJoinedSurfaces(postPlacinglist)
            endPts = Qluster(psrf_postPlacinglist.Surfaces()).nip
            
            possibleSrfs = []
            for startPt in startPts:
                for endPt in endPts:
                    dirVec = Vector.ByTwoPoints(startPt, endPt)
                    psrf_cluster = qluster.psrf_cluster
                    psrfs_cluster_rotate = create_rotationlist(psrf_cluster, startPt)
                    psrfs_cluster_rotate_tr = list(map(lambda x: Geometry.Translate(x, dirVec), psrfs_cluster_rotate))
                    possibleSrfs.extend(list(filter(lambda x: x.DoesIntersect(solid_placingBdry), psrfs_cluster_rotate_tr)))
                    #possibleSrfs.extend(list(filter(lambda x: x.Intersect(psrf_postPlacinglist) != True, psrfs_cluster_rotate_tr)))
                    
            dic = {}
            for i in possibleSrfs:
                #geo_intsct = psrf_postPlacinglist
                geo_intsct = i.Intersect(psrf_postPlacinglist.Thicken(100000,True))
                #area_polysrf_intsct = reduce(lambda acc, cur: acc + cur.Area, geo_intsct, 0)

#                dic[area_polysrf_intsct] = i
#            result = dic.get(min(list(dic.keys())))
            result = geo_intsct
            return result
            pass





        srf_initplaced = place_init(qset[0], solid_placingBdry)
        self.srf_initplaced = srf_initplaced
        postPlacinglist.append(srf_initplaced)
        self.postPlacinglist = postPlacinglist
        
        srf_nextplaced = place_next(qset[1], solid_placingBdry, postPlacinglist)
        self.srf_nextplaced = srf_nextplaced

#        def place_next(ql):
#            startPtlist = ql.nip
#            dic_cvxArea = {}
#            for startPt in startPtlist:
#                #dic_cvxArea = {}
#                for ip in postIPlist:
#                    #dic_cvxArea = {}
#                    endPt = Point.ByCoordinates(ip.X, ip.Y, ql.level_cl)
#                    dirVec = Vector.ByTwoPoints(startPt, endPt)
#                    ql = ql.translate(dirVec)
#                    rotList = ql.create_rotationlist_nip(ip)
#                    possibleSrfs = list(filter(checkIntersect, rotList))
#                    postSrf = PolySurface.ByJoinedSurfaces(postPlacinglist)
#                    
#                    for i in possibleSrfs:
#                        a = PolySurface.ByJoinedSurfaces([postSrf, i])
#                        b = a.PerimeterCurves()
#                        c = list(map(lambda x: x.StartPoint,b))
#                        d = ConvexHull_Maker(c).result
#                        e = d.Area
#                        dic_cvxArea[e] = i                      
#                        ## possibleSrfs들의 Convex Area 를 딕셔너리화 하고, 가장 작은 Area와 짝지어진 PossibleSrfs를 반환한다
#            result = dic_cvxArea.get(min(list(dic_cvxArea.keys()))).Surfaces()
#            return result
#            
#        def update_AllpostIP(srfs):
#            AllpostIP = list(map(lambda x: Qluster(x).ip, srfs))
#            self.postIPlist = []
#            self.postIPlist.append(AllpostIP)
#
#
#            
#
#
#        
#        def place_qlstInFloor(qset):
#            postPlacinglist = []
#            postIPlist = []
#            for i in range(len(qset)):
#                if i == 0:
#                    postPlacinglist.append(place_init(qset[i]))
#                    update_AllpostIP(postPlacinglist)
#                else:
#                    postPlacinglist.append(place_next(qset[i]))
#                    update_AllpostIP(postPlacinglist)
#            return postPlacinglist
#            
#        placedSrfs = place_qlstInFloor(qset)
#        self.placedSrfs = placedSrfs




# Place your code below this line
def colorize(i,r,g,b):
	return GeometryColor.ByGeometryColor(i, Color.ByARGB(125, r, g, b))

i = 3

#QS_obj = QsetPlacer(qset, PlacingBoundary)
#k = QS_obj.qluster
#l = QS_obj.qcircle_ip
#m = QS_obj.qset
#n = QS_obj.obj_rotated
#o = QlusterSetByLevel(InList).result
#q = QS_obj.placedSrfs


a = QlusterSetByLevel(InList)
qset = QlusterSetByLevel(InList).Qset[i]
b = QsetPlacer(qset, PlacingBoundary)
#b = QsetPlacer(a[i])
# Assign your output to the OUT variable.
OUT = {"A": a.Qset[i], "B": b.srf_cluster, "C": b.srf_initplaced, "D": b.srf_nextplaced}
# ----------------------------------------

string = StringInput("D")
valueAtKey_60 = DesignScript.Builtin.Dictionary.ValueAtKey(dictionary=python_script_2, key=string)
