# Dynamo graph 2-1_Room Separator(0628).dyn "2_Room Separator(0628)" (Dynamo 2.10.1.3976)
# packages: Clockwork for Dynamo 2.x 2.3.0

# note: 1. 수정 내용 요약: 불필요 노드 삭제-Code Block
# 2. 수정일자: 20210628
# note: 1. 수정 내용 요약: 불필요 노드 삭제-List.Sort/Line.ByStartPointEndPoint/List.Flatten
# 2. 수정일자: 20210628
# note: 1. 수정 내용 요약: 외부 인식 구간 삭제
# 2. 수정일자: 20210628

# group: Generic Mass & Level select
# note: 1. 수정 내용 요약: 그룹화 및 그룹 기능 설명 추가
# 2. 수정일자: 20210628
categories = Categories("OST_GenericModel")
all_elements_of_category = ElementsOfCategory(Category=categories)
levels = Levels("2nd")  # graph input

# group: 사용자 인풋 레벨 값과 element 레벨 비교
name = Level.Name(level=levels)
watch = Watch(name)
# note: 1. 수정 내용 요약: 그룹화 및 그룹 기능 설명 추가
# 2. 수정일자: 20210628
code_block = CodeBlock { "Level"; }
getParameterValueByName = Element.GetParameterValueByName(element=all_elements_of_category, parameterName=code_block)
name_2 = Level.Name(level=getParameterValueByName)
watch_2 = Watch(name_2)
eq = watch == watch_2
watch_3 = Watch(eq)
filterByBoolMask = List.FilterByBoolMask(list=all_elements_of_category, mask=watch_3)

# group: 대상 레벨에 해당 하는 element 선별
# note: 1. 수정 내용 요약: 해당 노드 설명 추가
# 2. 수정일자: 20210628
watch_4 = Watch(filterByBoolMask.in)

# group: 매스 중점 포인트 추출 및 리스트 정리
# note: 1. 수정 내용 요약: 그룹화 및 그룹 기능 설명 추가
# 2. 수정일자: 20210628
getLocation = Element.GetLocation(element=watch_4)
type = Object.Type(obj=getLocation)
firstItem = List.FirstItem(list=type)
removeIfNot = List.RemoveIfNot(list=getLocation, type=firstItem)

# group: 작업평면 생성
# note: 1. 수정 내용 요약: 그룹화 및 그룹 기능 설명 추가
# 2. 수정일자: 20210628
firstItem_2 = List.FirstItem(list=getLocation)
# note: 1. 수정 내용 요약: 불필요 노드 삭제-Plane.ByBestFitThroughPoints
# 2. 수정일자: 20210628
byOriginNormal = Plane.ByOriginNormal(origin=firstItem_2)

geometry = Element.Geometry(element=watch_4)

# group: 매스 바닥면 추출 및 리스트 정리
# note: 1. 수정 내용 요약: 그룹화 및 그룹 기능 설명 추가
# 2. 수정일자: 20210628
intersect = Geometry.Intersect(geometry=byOriginNormal, other=geometry)
flatten = List.Flatten(list=intersect)
clean = List.Clean(list=flatten)

# group: 매스별 바운더리 라인 추출 및 리스트 정리
# note: 1. 수정 내용 요약: 그룹화 및 그룹 기능 설명 추가
# 2. 수정일자: 20210628
perimeterCurves = Surface.PerimeterCurves(surface=clean)
clean_2 = List.Clean(list=perimeterCurves)
watch_5 = Watch(clean_2)

list_flatten_매스별_바운더리_라인_추출_및 = List.Flatten(list=watch_5)  # "List.Flatten@매스별 바운더리 라인 추출 및 리스트 정리"

# group: 매스 집합의 최외곽선 추출(by Graham Scan)
# note: 1. 수정 내용 요약: 그룹화 및 그룹 기능 설명 추가
# 2. 수정일자: 20210628
startPoint = Curve.StartPoint(curve=watch_5)
flatten_2 = List.Flatten(list=startPoint)
watch_6 = Watch(flatten_2)
string_from_object = FromObject(obj=watch_6)
python_script = Python(IN[0]=string_from_object)  # IronPython2
# ---------- python_script.python (20 lines) ----------
# Load the Python Standard and DesignScript Libraries
import sys
import clr
clr.AddReference('ProtoGeometry')
from Autodesk.DesignScript.Geometry import *

# The inputs to this node will be stored as a list in the IN variables.
dataEnteringNode = IN
inList = IN[0]

# Place your code below this line
outList = []
for i in inList:
	if i in outList:
		pass
	else:
		outList.append(i)

# Assign your output to the OUT variable.
OUT = outList
# ----------------------------------------
allIndicesOf = List.AllIndicesOf(list=string_from_object, item=python_script)
firstItem_3 = List.FirstItem(list=allIndicesOf@L2)
getItemAtIndex = List.GetItemAtIndex(list=flatten_2, index=firstItem_3)
graham_scan = Python(IN[0]=getItemAtIndex)  # IronPython2
# ---------- graham_scan.python (55 lines) ----------
import clr
clr.AddReference('ProtoGeometry')
from Autodesk.DesignScript.Geometry import *

def ToVals(pt):
	return [pt.X,pt.Y,pt.Z]

def ToPts(ptVals):
	return Point.ByCoordinates(ptVals[0],ptVals[1],ptVals[2])

def CreateOutline(pts):
	crvs = []
	i = 0
	while i < len(pts):
		if i == len(pts)-1:
			crvs.append(Line.ByStartPointEndPoint(pts[i],pts[0]))
		else:
			crvs.append(Line.ByStartPointEndPoint(pts[i],pts[i+1]))
		i = i+1
	return PolyCurve.ByJoinedCurves(crvs)

'''
Taken from Thomas Switzers awesome GitHub repo and modified to suit Dynamo Context
https://gist.github.com/arthur-e/5cf52962341310f438e96c1f3c3398b8
I take zero credit for this work other than porting it across.
'''
def convex_hull_graham(points):
	'''
	Returns points on convex hull in CCW order according to Graham's scan algorithm. 
	By Tom Switzer <thomas.switzer@gmail.com>.
	'''
	TURN_LEFT, TURN_RIGHT, TURN_NONE = (1, -1, 0)

	def cmp(a, b):
		return (a > b) - (a < b)
	
	def turn(p, q, r):
		return cmp((q[0] - p[0])*(r[1] - p[1]) - (r[0] - p[0])*(q[1] - p[1]), 0)
	
	def _keep_left(hull, r):
		while len(hull) > 1 and turn(hull[-2], hull[-1], r) != TURN_LEFT:
			hull.pop()
		if not len(hull) or hull[-1] != r:
			hull.append(r)
		return hull

	points = [ToVals(p) for p in points]	
	points = sorted(points)
	l = reduce(_keep_left, points, [])
	u = reduce(_keep_left, reversed(points), [])
	points = l.extend(u[i] for i in range(1, len(u) - 1)) or l
	points = [ToPts(p) for p in points]
	return CreateOutline(points)

OUT = convex_hull_graham(IN[0])
# ----------------------------------------

# group: Room Separator 기준 되는 커브들 추출 및 단일 리스트 생성
# note: 1. 수정 내용 요약: 그룹화 및 그룹 기능 설명 추가
# 2. 수정일자: 20210628
watch_매스_집합의_최외곽선_추출_by_graham = Watch(graham_scan)  # "Watch@매스 집합의 최외곽선 추출(by Graham Scan)"
explode = Geometry.Explode(geometry=watch_매스_집합의_최외곽선_추출_by_graham)
join = List.Join(list0=list_flatten_매스별_바운더리_라인_추출_및, list1=explode)

watch_7 = Watch(byOriginNormal)
byPlane = SketchPlane.ByPlane(plane=watch_7)

# group: 사용자 레벨 인풋값과 동일한 뷰 선택
# note: 1. 수정 내용 요약: 그룹 추가 및 그룹 기능 설명 추가
# 2. 수정일자: 20210628
categories_2 = Categories("OST_Views")
all_elements_of_category_2 = ElementsOfCategory(Category=categories_2)
isNull = Object.IsNull(object=all_elements_of_category_2)
filterByBoolMask_2 = List.FilterByBoolMask(list=all_elements_of_category_2, mask=isNull)
name_3 = Element.Name(element=filterByBoolMask_2.out)
name_4 = Element.Name(element=levels)
contains = String.Contains(str=name_3, searchFor=name_4)
filterByBoolMask_3 = List.FilterByBoolMask(list=filterByBoolMask_2.out, mask=contains)

# note: 1. 수정 내용 요약: view element 전달 방식 수정(level 선택과 연동되도록)
# 2. 수정일자: 20210628
firstItem_4 = List.FirstItem(list=filterByBoolMask_3.in)
watch_8 = Watch(firstItem_4)
fromCurve = Custom[RoomSeparator.FromCurve](curve=join, sketchPlane=byPlane, view=watch_8)  # package Clockwork for Dynamo 2.x; Creates room separation lines from geometry curves.
watch_9 = Watch(filterByBoolMask.out)
elevation = Level.Elevation(level=levels)

# group: 매스의 중점 최외곽 라인 형성 및 surface 형성
# note: 1. 수정 내용 요약: 그룹화 및 그룹 기능 설명 추가
# 2. 수정일자: 20210628
graham_scan_2 = Python(IN[0]=removeIfNot)  # IronPython2; same code as graham_scan
byPatch = Surface.ByPatch(closedCurve=graham_scan_2)

# group: 중점 기반 surface와 겹치는 매스 바운더리 추출구간
doesIntersect = Geometry.DoesIntersect(geometry=byPatch, other=list_flatten_매스별_바운더리_라인_추출_및)
filterByBoolMask_4 = List.FilterByBoolMask(list=list_flatten_매스별_바운더리_라인_추출_및, mask=doesIntersect)

watch_10 = Watch(filterByBoolMask_4.in)
watch_11 = Watch(filterByBoolMask_4.out)
