# Dynamo graph 2-1_Room Separator(0630).dyn (Dynamo 2.10.1.3976)

# group: Generic Mass & Level select
categories = Categories("OST_GenericModel")
all_elements_of_category = ElementsOfCategory(Category=categories)
levels = Levels("2nd")
