# Dynamo graph 2-2_Room Generating(0628).dyn (Dynamo 2.10.1.3976)
# packages: MEPover 2020.6.2

# group: Room 자동 생성 구간
select_phase = RevitPhases("New Construction")
rooms_place_automatically_for = Custom[Rooms place automatically for all levels](Phase=select_phase)  # package MEPover; This node will attempt to create rooms automatically for every level
python_script = Python()  # IronPython2; unwired: IN[0]
# ---------- python_script.python (49 lines) ----------
import clr

clr.AddReference("RevitServices")
import RevitServices
from RevitServices.Persistence import DocumentManager
from RevitServices.Transactions import TransactionManager
doc = DocumentManager.Instance.CurrentDBDocument

clr.AddReference("RevitAPI")
import Autodesk
from Autodesk.Revit.DB import *

clr.AddReference("RevitNodes")
import Revit
clr.ImportExtensions(Revit.Elements)
clr.ImportExtensions(Revit.GeometryConversion)

collector = FilteredElementCollector(doc)
levels = collector.OfClass(Level).ToElements()

phase = UnwrapElement(IN[0])
limitoffset = 8
listout = []

for j,level in enumerate(levels):
	try:
		planTopology = doc.get_PlanTopology(level)
		rooms = []
		
		for i,plancircuit in enumerate(planTopology.Circuits):
			if plancircuit.IsRoomLocated == True:
				continue
			TransactionManager.Instance.EnsureInTransaction(doc)
			room = doc.Create.NewRoom(phase)
			room.Name = "Name" + str(i)
			room.Number = str(j) + "." + str(i)
			room.LimitOffset = limitoffset
			try:
				room2 = doc.Create.NewRoom(room,plancircuit)
			except:
				continue
			TransactionManager.Instance.TransactionTaskDone()
			rooms.append(room2)
		listout.append(rooms)
	except:
		continue


OUT = listout
# ----------------------------------------
