# Dynamo graph 2-3_Room with Param Generating(0701).dyn "2-3_Room Generating(0701)_whole corridor test" (Dynamo 2.10.1.3976)

categories = Categories("OST_GenericModel")
all_elements_of_category = ElementsOfCategory(Category=categories)

# group: 모든 룸 불러오기
categories_2 = Categories("OST_Rooms")
all_elements_of_category_2 = ElementsOfCategory(Category=categories_2)
watch = Watch(all_elements_of_category_2)
flatten = List.Flatten(list=watch)

# group: 룸 형상화 및 중점 추출
geometry = Element.Geometry(element=flatten)
centroid = Solid.Centroid(solid=geometry)

# group: 현재 뷰에서 모든 Generic Box 불러오기 및 형상화
all_elements_in_active_view = ElementsInView()
watch_2 = Watch(all_elements_in_active_view)
name = Element.Name(element=watch_2)
code_block = CodeBlock { "Room"; "Space Planning Box"; }
contains = String.Contains(str=name, searchFor=code_block.out1)
filterByBoolMask = List.FilterByBoolMask(list=watch_2, mask=contains)
watch_3 = Watch(filterByBoolMask.in)

# group: 현재 작업 레벨 분리
code_block_2 = CodeBlock { "Level"; }
getParameterValueByName = Element.GetParameterValueByName(element=watch_3, parameterName=code_block_2)
string_from_object = FromObject(object=getParameterValueByName)
code_block_3 = CodeBlock { "2nd"; }
contains_2 = String.Contains(str=string_from_object, searchFor=code_block_3)
filterByBoolMask_2 = List.FilterByBoolMask(list=watch_3, mask=contains_2)

# group: Box 중 "Corridor Box" 분리
code_block_4 = CodeBlock { "Room Name"; }
getParameterValueByName_2 = Element.GetParameterValueByName(element=filterByBoolMask_2.in, parameterName=code_block_4)
string_from_object_2 = FromObject(object=getParameterValueByName_2)
code_block_5 = CodeBlock { "Corridor"; }
contains_3 = String.Contains(str=string_from_object_2, searchFor=code_block_5)
filterByBoolMask_3 = List.FilterByBoolMask(list=filterByBoolMask_2.in, mask=contains_3)

geometry_2 = Element.Geometry(element=filterByBoolMask_3.out)

# group: Room 객체 중 Corridor 에 해당하는 객체 분리
flatten_2 = List.Flatten(list=centroid)
flatten_3 = List.Flatten(list=geometry_2)
doesIntersect = Geometry.DoesIntersect(geometry=flatten_2, other=flatten_3, lacing=CrossProduct)
allFalse = List.AllFalse(list=doesIntersect@L2)
watch_4 = Watch(allFalse)
filterByBoolMask_4 = List.FilterByBoolMask(list=flatten, mask=watch_4)

# group: Room 중 Corridor 해당 객체 정보입력
code_block_6 = CodeBlock { "Name"; }
code_block_7 = CodeBlock { "Room Name"; }
getParameterValueByName_3 = Element.GetParameterValueByName(element=filterByBoolMask_3.in, parameterName=code_block_7)
setParameterByName = Element.SetParameterByName(element=filterByBoolMask_4.in, parameterName=code_block_6, value=getParameterValueByName_3)

# group: Room 중 "Corridor " 제외 객체
watch_5 = Watch(filterByBoolMask_4.out)

# group: 룸 형상화 및 중점 추출
geometry_3 = Element.Geometry(element=watch_5)
centroid_2 = Solid.Centroid(solid=geometry_3)

code_block_8 = CodeBlock { 100; }
byARGB = Color.ByARGB(a=code_block_8, r=code_block_8)
byGeometryColor = Modifiers.GeometryColor.ByGeometryColor(geometry=geometry_3, color=byARGB)

# group: 1:1 겹침 없음
code_block_9 = CodeBlock {  }
code_block_10 = CodeBlock {  }

# group: 3개 겹침
code_block_11 = CodeBlock {  }
code_block_12 = CodeBlock {  }

# group: Box 중 "Corridor Box" 제외 객체
watch_6 = Watch(filterByBoolMask_3.out)

flatten_4 = List.Flatten(list=centroid_2)
geometry_4 = Element.Geometry(element=watch_6)
flatten_5 = List.Flatten(list=geometry_4)
doesIntersect_2 = Geometry.DoesIntersect(geometry=flatten_4, other=flatten_5, lacing=CrossProduct)
watch_7 = Watch(doesIntersect_2)
filterByBoolMask_5 = List.FilterByBoolMask(list=watch_6, mask=watch_7@L2)
watch_8 = Watch(filterByBoolMask_5.in)
count = List.Count(list=watch_8@L2)
watch_9 = Watch(count)
code_block_13 = CodeBlock(a=watch_9) { a>1; }
watch_10 = Watch(code_block_13)
filterByBoolMask_6 = List.FilterByBoolMask(list=filterByBoolMask_5.in, mask=watch_10)
watch_11 = Watch(filterByBoolMask_6.in)
flatten_6 = List.Flatten(list=watch_11)
uniqueItems = List.UniqueItems(list=flatten_6)

# group: 2개 겹침
code_block_14 = CodeBlock {  }
code_block_15 = CodeBlock {  }

watch_12 = Watch(watch_5)
watch_13 = Watch(filterByBoolMask_6.out)
geometry_5 = Element.Geometry(element=watch_13)
flatten_7 = List.Flatten(list=geometry_5)
geometry_6 = Element.Geometry(element=watch_12)
centroid_3 = Solid.Centroid(solid=geometry_6)
flatten_8 = List.Flatten(list=centroid_3)
doesIntersect_3 = Geometry.DoesIntersect(geometry=flatten_7, other=flatten_8, lacing=CrossProduct)
filterByBoolMask_7 = List.FilterByBoolMask(list=watch_12, mask=doesIntersect_3@L2)
watch_14 = Watch(filterByBoolMask_7.in)
area = Room.Area()  # unwired: room
maximumItemByKey = List.MaximumItemByKey(list=watch_14@L2, keyFunction=area)
watch_15 = Watch(maximumItemByKey)
code_block_16 = CodeBlock { "Name"; }
flatten_9 = List.Flatten(list=watch_13)
watch_16 = Watch(flatten_9)
code_block_17 = CodeBlock { "Room Name"; }
getParameterValueByName_4 = Element.GetParameterValueByName(element=watch_16, parameterName=code_block_17)
watch_17 = Watch(getParameterValueByName_4)
setParameterByName_2 = Element.SetParameterByName(element=watch_15, parameterName=code_block_16, value=watch_17)
watch_18 = Watch(watch_12)
count_2 = List.Count(list=watch_11@L2)
code_block_18 = CodeBlock { 3; }
eq = count_2 == code_block_18
filterByBoolMask_8 = List.FilterByBoolMask(list=watch_11, mask=eq)
watch_19 = Watch(filterByBoolMask_8.in)
flatten_10 = List.Flatten(list=watch_19)
code_block_19 = CodeBlock { "Area"; }
getParameterValueByName_5 = Element.GetParameterValueByName(parameterName=code_block_19)  # unwired: element
maximumItemByKey_2 = List.MaximumItemByKey(list=flatten_10, keyFunction=getParameterValueByName_5)
geometry_7 = Element.Geometry(element=maximumItemByKey_2)
watch_20 = Watch(flatten_4)
doesIntersect_4 = Geometry.DoesIntersect(geometry=geometry_7, other=watch_20, lacing=Longest)
filterByBoolMask_9 = List.FilterByBoolMask(list=watch_18, mask=doesIntersect_4)
watch_21 = Watch(filterByBoolMask_9.in)
code_block_20 = CodeBlock { "Area"; }
getParameterValueByName_6 = Element.GetParameterValueByName(parameterName=code_block_20)  # unwired: element
sortByKey = List.SortByKey(list=watch_21@L1, keys=getParameterValueByName_6)
watch_22 = Watch(sortByKey.sortedList)
flatten_11 = List.Flatten(list=watch_22)
code_block_21 = CodeBlock { "Name"; }
code_block_22 = CodeBlock { "Area"; }
getParameterValueByName_7 = Element.GetParameterValueByName(parameterName=code_block_22)  # unwired: element
sortByKey_2 = List.SortByKey(list=flatten_10@L1, keys=getParameterValueByName_7)
watch_23 = Watch(sortByKey_2.sortedList)
flatten_12 = List.Flatten(list=watch_23)
code_block_23 = CodeBlock { "Room Name"; }
getParameterValueByName_8 = Element.GetParameterValueByName(element=flatten_12, parameterName=code_block_23)
watch_24 = Watch(getParameterValueByName_8)
setParameterByName_3 = Element.SetParameterByName(element=flatten_11, parameterName=code_block_21, value=watch_24)
count_3 = List.Count(list=watch_14@L2)
watch_25 = Watch(count_3)
code_block_24 = CodeBlock(a=watch_25) { a==2; }
watch_26 = Watch(code_block_24)
filterByBoolMask_10 = List.FilterByBoolMask(list=watch_14, mask=watch_26)
watch_27 = Watch(filterByBoolMask_10.in)
flatten_13 = List.Flatten(list=watch_27)
watch_28 = Watch(flatten_13)
code_block_25 = CodeBlock { "Name"; }
watch_29 = Watch(filterByBoolMask_6.in)
flatten_14 = List.Flatten(list=watch_29)
geometry_8 = Element.Geometry(element=watch_27)
centroid_4 = Solid.Centroid(solid=geometry_8)
flatten_15 = List.Flatten(list=centroid_4)
geometry_9 = Element.Geometry(element=flatten_14)
flatten_16 = List.Flatten(list=geometry_9)
doesIntersect_5 = Geometry.DoesIntersect(geometry=flatten_15, other=flatten_16, lacing=CrossProduct)
watch_30 = Watch(doesIntersect_5)
filterByBoolMask_11 = List.FilterByBoolMask(list=flatten_14, mask=watch_30@L2)
watch_31 = Watch(filterByBoolMask_11.in)
code_block_26 = CodeBlock { "Area"; }
getParameterValueByName_9 = Element.GetParameterValueByName(parameterName=code_block_26)  # unwired: element
minimumItemByKey = List.MinimumItemByKey(list=watch_31@L2, keyFunction=getParameterValueByName_9)
watch_32 = Watch(minimumItemByKey)
code_block_27 = CodeBlock { "Room Name"; }
getParameterValueByName_10 = Element.GetParameterValueByName(element=watch_32, parameterName=code_block_27)
watch_33 = Watch(getParameterValueByName_10)
setParameterByName_4 = Element.SetParameterByName(element=watch_28, parameterName=code_block_25, value=watch_33)
