# Dynamo graph 2-3_Room with Param Generating(0702).dyn (Dynamo 2.10.1.3976)

categories = Categories("OST_GenericModel")
all_elements_of_category = ElementsOfCategory(Category=categories)

# group: 모든 룸 불러오기
categories_2 = Categories("OST_Rooms")
all_elements_of_category_2 = ElementsOfCategory(Category=categories_2)
watch = Watch(all_elements_of_category_2)
flatten = List.Flatten(list=watch)

# group: 룸 형상화 및 중점 추출
geometry = Element.Geometry(element=flatten)
centroid = Solid.Centroid(solid=geometry)

# group: 현재 뷰에서 모든 Generic Box 불러오기 및 형상화
all_elements_in_active_view = ElementsInView()
watch_2 = Watch(all_elements_in_active_view)
name = Element.Name(element=watch_2)
code_block = CodeBlock { "Room"; "Space Planning Box"; }
contains = String.Contains(str=name, searchFor=code_block.out1)
filterByBoolMask = List.FilterByBoolMask(list=watch_2, mask=contains)
watch_3 = Watch(filterByBoolMask.in)

# group: 현재 작업 레벨 분리
code_block_2 = CodeBlock { "Level"; }
getParameterValueByName = Element.GetParameterValueByName(element=watch_3, parameterName=code_block_2)
string_from_object = FromObject(object=getParameterValueByName)
code_block_3 = CodeBlock { "2nd"; }
contains_2 = String.Contains(str=string_from_object, searchFor=code_block_3)
filterByBoolMask_2 = List.FilterByBoolMask(list=watch_3, mask=contains_2)

# group: Box 중 "Corridor Box" 분리
code_block_4 = CodeBlock { "Room Name"; }
getParameterValueByName_2 = Element.GetParameterValueByName(element=filterByBoolMask_2.in, parameterName=code_block_4)
string_from_object_2 = FromObject(object=getParameterValueByName_2)
code_block_5 = CodeBlock { "Corridor"; }
contains_3 = String.Contains(str=string_from_object_2, searchFor=code_block_5)
filterByBoolMask_3 = List.FilterByBoolMask(list=filterByBoolMask_2.in, mask=contains_3)

geometry_2 = Element.Geometry(element=filterByBoolMask_3.out)

# group: Room 객체 중 Corridor 에 해당하는 객체 분리
flatten_2 = List.Flatten(list=centroid)
flatten_3 = List.Flatten(list=geometry_2)
doesIntersect = Geometry.DoesIntersect(geometry=flatten_2, other=flatten_3, lacing=CrossProduct)
allFalse = List.AllFalse(list=doesIntersect@L2)
watch_4 = Watch(allFalse)
filterByBoolMask_4 = List.FilterByBoolMask(list=flatten, mask=watch_4)

# group: Room 중 "Corridor " 제외 객체
watch_5 = Watch(filterByBoolMask_4.out)

# group: 룸 형상화 및 중점 추출
geometry_3 = Element.Geometry(element=watch_5)
centroid_2 = Solid.Centroid(solid=geometry_3)

code_block_6 = CodeBlock { 100; }
byARGB = Color.ByARGB(a=code_block_6, r=code_block_6)
byGeometryColor = Modifiers.GeometryColor.ByGeometryColor(geometry=geometry_3, color=byARGB)

# group: 룸1:박스1
code_block_7 = CodeBlock {  }
code_block_8 = CodeBlock {  }

# group: 룸1:박스3
code_block_9 = CodeBlock {  }
code_block_10 = CodeBlock {  }

# group: 룸1:박스2
code_block_11 = CodeBlock {  }
code_block_12 = CodeBlock {  }

# group: Room 중 "Corridor " 제외 객체
watch_6 = Watch(watch_5)

watch_7 = Watch(watch_6)

# group: Box 중 "Corridor Box" 제외 객체
watch_8 = Watch(filterByBoolMask_3.out)

# group: "Corridor Box" 제외 형상 추출
geometry_4 = Element.Geometry(element=watch_8)
flatten_4 = List.Flatten(list=geometry_4)

# group: 룸 중점(Corridor제외), 박스형상(Corridor제외) 간 교차 판정
flatten_5 = List.Flatten(list=centroid_2)
doesIntersect_2 = Geometry.DoesIntersect(geometry=flatten_4, other=flatten_5, lacing=CrossProduct)
watch_9 = Watch(doesIntersect_2)
filterByBoolMask_5 = List.FilterByBoolMask(list=watch_8, mask=watch_9@L2)

# group: 룸1개에 박스 2개이상 곂침 판별
watch_10 = Watch(filterByBoolMask_5.in)
count = List.Count(list=watch_10@L2)
watch_11 = Watch(count)
code_block_13 = CodeBlock(a=watch_11) { a>1; }
watch_12 = Watch(code_block_13)
filterByBoolMask_6 = List.FilterByBoolMask(list=filterByBoolMask_5.in, mask=watch_12)

watch_13 = Watch(filterByBoolMask_6.in)
count_2 = List.Count(list=watch_13@L2)
code_block_14 = CodeBlock { 3; }
eq = count_2 == code_block_14
filterByBoolMask_7 = List.FilterByBoolMask(list=watch_13, mask=eq)
watch_14 = Watch(filterByBoolMask_7.in)
flatten_6 = List.Flatten(list=watch_14)
code_block_15 = CodeBlock { "Area"; }
getParameterValueByName_3 = Element.GetParameterValueByName(parameterName=code_block_15)  # unwired: element
maximumItemByKey = List.MaximumItemByKey(list=flatten_6, keyFunction=getParameterValueByName_3)
geometry_5 = Element.Geometry(element=maximumItemByKey)
watch_15 = Watch(flatten_5)
doesIntersect_3 = Geometry.DoesIntersect(geometry=geometry_5, other=watch_15, lacing=CrossProduct)
filterByBoolMask_8 = List.FilterByBoolMask(list=watch_7, mask=doesIntersect_3@L2)
watch_16 = Watch(filterByBoolMask_8.in)
code_block_16 = CodeBlock { "Area"; }
getParameterValueByName_4 = Element.GetParameterValueByName(parameterName=code_block_16)  # unwired: element
sortByKey = List.SortByKey(list=watch_16@L1, keys=getParameterValueByName_4)
watch_17 = Watch(sortByKey.sortedList)
flatten_7 = List.Flatten(list=watch_17)
code_block_17 = CodeBlock { "Name"; }
code_block_18 = CodeBlock { "Area"; }
getParameterValueByName_5 = Element.GetParameterValueByName(parameterName=code_block_18)  # unwired: element
sortByKey_2 = List.SortByKey(list=flatten_6@L1, keys=getParameterValueByName_5)
watch_18 = Watch(sortByKey_2.sortedList)
flatten_8 = List.Flatten(list=watch_18)
code_block_19 = CodeBlock { "Room Name"; }
getParameterValueByName_6 = Element.GetParameterValueByName(element=flatten_8, parameterName=code_block_19)  # frozen
watch_19 = Watch(getParameterValueByName_6)
setParameterByName = Element.SetParameterByName(element=flatten_7, parameterName=code_block_17, value=watch_19)

# group: Room 중 "Corridor " 제외 객체
watch_20 = Watch(watch_6)

# group: 곂침 없는 박스 및 형상 추출
watch_21 = Watch(filterByBoolMask_6.out)
geometry_6 = Element.Geometry(element=watch_21)
flatten_9 = List.Flatten(list=geometry_6)

# group: Room 중 "Corridor " 제외 객체 중점
geometry_7 = Element.Geometry(element=watch_20)
centroid_3 = Solid.Centroid(solid=geometry_7)
flatten_10 = List.Flatten(list=centroid_3)

# group: 룸들 중 박스 중복 매칭 판별
doesIntersect_4 = Geometry.DoesIntersect(geometry=flatten_9, other=flatten_10, lacing=CrossProduct)
filterByBoolMask_9 = List.FilterByBoolMask(list=watch_20, mask=doesIntersect_4@L2)

watch_22 = Watch(filterByBoolMask_9.in)
area = Room.Area()  # unwired: room
maximumItemByKey_2 = List.MaximumItemByKey(list=watch_22@L2, keyFunction=area)
watch_23 = Watch(maximumItemByKey_2)
flatten_11 = List.Flatten(list=watch_21)
watch_24 = Watch(flatten_11)

# group: Room 중 Corridor 해당 객체 정보입력
code_block_20 = CodeBlock()
# ---------- code_block_20.designscript (6 lines) ----------
[
"Name",
"Interior Finish",
"Exterior Finish",
"Department"
];
# ----------------------------------------
code_block_21 = CodeBlock { "Room Name"; }
getParameterValueByName_7 = Element.GetParameterValueByName(element=watch_24, parameterName=code_block_21)
code_block_22 = CodeBlock { "Interior Finish"; }
getParameterValueByName_8 = Element.GetParameterValueByName(element=watch_24, parameterName=code_block_22)
code_block_23 = CodeBlock { "Exterior Finish"; }
getParameterValueByName_9 = Element.GetParameterValueByName(element=watch_24, parameterName=code_block_23)
code_block_24 = CodeBlock { "Department"; }
getParameterValueByName_10 = Element.GetParameterValueByName(element=watch_24, parameterName=code_block_24)
list_create = List.Create(item0=getParameterValueByName_7, item1=getParameterValueByName_8, item2=getParameterValueByName_9, item3=getParameterValueByName_10)
transpose = List.Transpose(lists=list_create)
multi_SetParameterByName = Python(IN[0]=watch_23, IN[1]=code_block_20, IN[2]=transpose)  # IronPython2
# ---------- multi_SetParameterByName.python (44 lines) ----------
# Enable Python support and load DesignScript library
import clr
clr.AddReference('ProtoGeometry')
clr.AddReference('RevitNodes')
from Autodesk.DesignScript.Geometry import *

import Revit
clr.ImportExtensions(Revit.Elements)

class DepthError(Exception):
    def __str__(self):
        return "Depth of IN[2] must be modified!"

# Count List Depth
def depthCount(x):
    return 1 + max(map(depthCount, x)) if x and isinstance(x, list) else 0

#Synchronize List Depth for 'for' statement
if isinstance(IN[0], list):
 elems = IN[0]
else:
 elems = [IN[0]]

if isinstance(IN[1], list):
 paramNames = IN[1]
else:
 paramNames = [IN[1]]

if not isinstance(IN[2], list):
 values = [[IN[2]]]
elif depthCount(IN[2]) == 1:
 values = [IN[2]]
elif depthCount(IN[2]) == 2:
 values = IN[2]
else:
 raise DepthError
 

#Set paramteter values
for e, value in zip(elems,values):
 for p, v in zip(paramNames,value):
  e.SetParameterByName(p,v)
  
OUT = elems
# ----------------------------------------

# group: Room 중 Corridor 해당 객체 정보입력
code_block_25 = CodeBlock()  # same code as code_block_20
code_block_26 = CodeBlock { "Room Name"; }
getParameterValueByName_11 = Element.GetParameterValueByName(element=filterByBoolMask_3.in, parameterName=code_block_26)
code_block_27 = CodeBlock { "Interior Finish"; }
getParameterValueByName_12 = Element.GetParameterValueByName(element=filterByBoolMask_3.in, parameterName=code_block_27)
code_block_28 = CodeBlock { "Exterior Finish"; }
getParameterValueByName_13 = Element.GetParameterValueByName(element=filterByBoolMask_3.in, parameterName=code_block_28)
code_block_29 = CodeBlock { "Department"; }
getParameterValueByName_14 = Element.GetParameterValueByName(element=filterByBoolMask_3.in, parameterName=code_block_29)
list_create_2 = List.Create(item0=getParameterValueByName_11, item1=getParameterValueByName_12, item2=getParameterValueByName_13, item3=getParameterValueByName_14)
transpose_2 = List.Transpose(lists=list_create_2)
multi_SetParameterByName_2 = Python(IN[0]=filterByBoolMask_4.in, IN[1]=code_block_25, IN[2]=transpose_2)  # IronPython2; same code as multi_SetParameterByName

watch_25 = Watch(filterByBoolMask_9.in)
count_3 = List.Count(list=watch_25@L2)
watch_26 = Watch(count_3)
code_block_30 = CodeBlock(a=watch_26) { a==2; }
watch_27 = Watch(code_block_30)
filterByBoolMask_10 = List.FilterByBoolMask(list=watch_25, mask=watch_27)
watch_28 = Watch(filterByBoolMask_10.in)
geometry_8 = Element.Geometry(element=watch_28)
centroid_4 = Solid.Centroid(solid=geometry_8)
flatten_12 = List.Flatten(list=centroid_4)
watch_29 = Watch(filterByBoolMask_6.in)
flatten_13 = List.Flatten(list=watch_29)
geometry_9 = Element.Geometry(element=flatten_13)
flatten_14 = List.Flatten(list=geometry_9)
doesIntersect_5 = Geometry.DoesIntersect(geometry=flatten_12, other=flatten_14, lacing=CrossProduct)
anyTrue = List.AnyTrue(list=doesIntersect_5@L2)
filterByBoolMask_11 = List.FilterByBoolMask(list=flatten_13, mask=doesIntersect_5@L2)
watch_30 = Watch(filterByBoolMask_11.in)
code_block_31 = CodeBlock { "Room Name"; }
getParameterValueByName_15 = Element.GetParameterValueByName(element=watch_30, parameterName=code_block_31)
code_block_32 = CodeBlock { "Area"; }
sortByKey_3 = List.SortByKey(list=watch_30@L1, keys=code_block_32)
code_block_33 = CodeBlock { "Name"; }
getParameterValueByName_16 = Element.GetParameterValueByName(element=watch_28, parameterName=code_block_33)
getParameterValueByName_17 = Element.GetParameterValueByName(parameterName=code_block_32)  # unwired: element
minimumItemByKey = List.MinimumItemByKey(list=watch_30@L2, keyFunction=getParameterValueByName_17)
code_block_34 = CodeBlock { "Room Name"; }
getParameterValueByName_18 = Element.GetParameterValueByName(element=minimumItemByKey, parameterName=code_block_34)
flatten_15 = List.Flatten(list=watch_28)
watch_31 = Watch(flatten_15)
isEmpty = List.IsEmpty(list=minimumItemByKey@L2)
filterByBoolMask_12 = List.FilterByBoolMask(list=minimumItemByKey, mask=isEmpty)
watch_32 = Watch(filterByBoolMask_12.out)

# group: Room 중 Corridor 해당 객체 정보입력
code_block_35 = CodeBlock()  # same code as code_block_20
code_block_36 = CodeBlock { "Room Name"; }
getParameterValueByName_19 = Element.GetParameterValueByName(element=watch_32, parameterName=code_block_36)
code_block_37 = CodeBlock { "Interior Finish"; }
getParameterValueByName_20 = Element.GetParameterValueByName(element=watch_32, parameterName=code_block_37)
code_block_38 = CodeBlock { "Exterior Finish"; }
getParameterValueByName_21 = Element.GetParameterValueByName(element=watch_32, parameterName=code_block_38)
code_block_39 = CodeBlock { "Department"; }
getParameterValueByName_22 = Element.GetParameterValueByName(element=watch_32, parameterName=code_block_39)
list_create_3 = List.Create(item0=getParameterValueByName_19, item1=getParameterValueByName_20, item2=getParameterValueByName_21, item3=getParameterValueByName_22)
transpose_3 = List.Transpose(lists=list_create_3)
multi_SetParameterByName_3 = Python(IN[0]=watch_31, IN[1]=code_block_35, IN[2]=transpose_3)  # IronPython2; same code as multi_SetParameterByName

code_block_40 = CodeBlock { "Name"; }
getParameterValueByName_23 = Element.GetParameterValueByName(element=multi_SetParameterByName_3, parameterName=code_block_40)

# group: Room 중 Corridor 해당 객체 정보입력
code_block_41 = CodeBlock()  # same code as code_block_20
code_block_42 = CodeBlock { "Room Name"; }
getParameterValueByName_24 = Element.GetParameterValueByName(element=flatten_8, parameterName=code_block_42)
code_block_43 = CodeBlock { "Interior Finish"; }
getParameterValueByName_25 = Element.GetParameterValueByName(element=flatten_8, parameterName=code_block_43)
code_block_44 = CodeBlock { "Exterior Finish"; }
getParameterValueByName_26 = Element.GetParameterValueByName(element=flatten_8, parameterName=code_block_44)
code_block_45 = CodeBlock { "Department"; }
getParameterValueByName_27 = Element.GetParameterValueByName(element=flatten_8, parameterName=code_block_45)
list_create_4 = List.Create(item0=getParameterValueByName_24, item1=getParameterValueByName_25, item2=getParameterValueByName_26, item3=getParameterValueByName_27)
transpose_4 = List.Transpose(lists=list_create_4)
multi_SetParameterByName_4 = Python(IN[0]=flatten_7, IN[1]=code_block_41, IN[2]=transpose_4)  # IronPython2; same code as multi_SetParameterByName
