# Dynamo graph Bidding_Draft Model_Automation(20231114)_rCs1.dyn (Dynamo 2.16.1.2727)
# Create Draft Modeling in Plant-Architecture Bidding Stage

# group: 그리드 필터
categories = Categories("OST_Grids")
all_elements_of_category = ElementsOfCategory(Category=categories)
string = StringInput("Name")
parameterByName = Parameter.ParameterByName(element=all_elements_of_category, name=string)
value = Parameter.Value(parameter=parameterByName)
string_2 = StringInput("x")
boolean = BoolSelector(true)
contains = String.Contains(string=value, searchFor=string_2, ignoreCase=boolean)
string_3 = StringInput("y")
contains_2 = String.Contains(string=value, searchFor=string_3, ignoreCase=boolean)
eq = contains == contains_2
boolean_2 = BoolSelector(false)
allIndicesOf = List.AllIndicesOf(list=eq, item=boolean_2)
getItemAtIndex = List.GetItemAtIndex(list=all_elements_of_category, index=allIndicesOf)
curve = Grid.Curve(grid=getItemAtIndex)

# group: 그리드 방향 조정 ( + : → ↑ )
startPoint = Curve.StartPoint(curve=curve)
endPoint = Curve.EndPoint(curve=curve)
byTwoPoints = Vector.ByTwoPoints(start=startPoint, end=endPoint)
normalized = Vector.Normalized(vector=byTwoPoints)
X = Vector.X(vector=normalized)
round = Math.Round(number=X)
number = DoubleInput(-1)
eq_2 = round == number
Y = Vector.Y(vector=normalized)
round_2 = Math.Round(number=Y)
eq_3 = round_2 == number
eq_4 = eq_2 == eq_3
filterByBoolMask = List.FilterByBoolMask(list=curve, mask=eq_4)
reverse = Curve.Reverse(curve=filterByBoolMask.out)
join = List.Join(list0=filterByBoolMask.in, list1=reverse)

# group: 그리드 교차점 추출
intersect = Geometry.Intersect(geometry=join, other=join, lacing=CrossProduct)
flatten = List.Flatten(list=intersect)
type = Object.Type(object=flatten)
string_4 = StringInput("point")
boolean_3 = BoolSelector(true)
contains_3 = String.Contains(string=type, searchFor=string_4, ignoreCase=boolean_3)
allIndicesOf_2 = List.AllIndicesOf(list=contains_3, item=boolean_3)
getItemAtIndex_2 = List.GetItemAtIndex(list=flatten, index=allIndicesOf_2)
pruneDuplicates = Point.PruneDuplicates(points=getItemAtIndex_2)

# group: 레벨 데이터 정리
categories_2 = Categories("OST_Levels")
all_elements_of_category_2 = ElementsOfCategory(Category=categories_2)
elevation = Level.Elevation(level=all_elements_of_category_2)
sort = List.Sort(list=elevation)
indexOf = List.IndexOf(list=elevation, element=sort)
getItemAtIndex_3 = List.GetItemAtIndex(list=all_elements_of_category_2, index=indexOf)
name = Level.Name(level=getItemAtIndex_3)
string_5 = StringInput("BOF")
boolean_4 = BoolSelector(true)
contains_4 = String.Contains(string=name, searchFor=string_5, ignoreCase=boolean_4)
filterByBoolMask_2 = List.FilterByBoolMask(list=getItemAtIndex_3, mask=contains_4)
count = List.Count(list=filterByBoolMask_2.out)
code_block = CodeBlock(n=count) { n-1; }
removeItemAtIndex = List.RemoveItemAtIndex(list=filterByBoolMask_2.out, indices=code_block)
restOfItems = List.RestOfItems(list=filterByBoolMask_2.out)
lastItem = List.LastItem(list=filterByBoolMask_2.out)

# group: 벽체 정보 불러오기 (레벨 별)
categories_3 = Categories("OST_Walls")
all_elements_of_category_3 = ElementsOfCategory(Category=categories_3)
getLocation = Element.GetLocation(element=all_elements_of_category_3)
number_2 = DoubleInput(0.5)
pointAtParameter = Curve.PointAtParameter(curve=getLocation, param=number_2)
Z = Point.Z(point=pointAtParameter)
round_3 = Math.Round(number=Z)
uniqueItems = List.UniqueItems(list=round_3)
allIndicesOf_3 = List.AllIndicesOf(list=round_3, item=uniqueItems)
# note: 레벨 별 모든 벽 모델
getItemAtIndex_4 = List.GetItemAtIndex(list=all_elements_of_category_3, index=allIndicesOf_3)
elevation_2 = Level.Elevation(level=removeItemAtIndex)
round_4 = Math.Round(number=elevation_2)
allIndicesOf_4 = List.AllIndicesOf(list=round_3, item=round_4)
# note: 루프층 제외한 벽 모델
getItemAtIndex_5 = List.GetItemAtIndex(list=all_elements_of_category_3, index=allIndicesOf_4)

# group: 독립기초 패밀리 선택
n3_select_foundation_types = FamilyTypes("FT211-Footing-Rectangular_R1:H_SF_ACF_W2400xL2400xT500_Bitumen")  # "3. Select : Foundation Types"; graph input

# group: 기둥 패밀리 선택
n4_select_pedestal_types = StructuralColumnTypes("H_SC_ACC_W600xL600")  # "4. Select : Pedestal Types"; graph input

# group: 기둥 패밀리 선택
n5_select_structural_column_types = StructuralColumnTypes("H_SC_ACC_W600xL600")  # "5. Select : Structural Column Types"; graph input

# group: 기둥 모델링
Z_2 = Point.Z(point=pruneDuplicates)
number_3 = DoubleInput(-1)
mul = Z_2 * number_3
translate = Geometry.Translate(geometry=pruneDuplicates, zTranslation=mul, lacing=Shortest)
elevation_3 = Level.Elevation(level=filterByBoolMask_2.out)
number_4 = DoubleInput(1)
round_5 = Math.Round(number=elevation_3, digits=number_4)
translate_2 = Geometry.Translate(geometry=translate, zTranslation=round_5, lacing=CrossProduct)
byPoints = PolyCurve.ByPoints(points=translate_2)
curves = PolyCurve.Curves(polyCurve=byPoints)
transpose = List.Transpose(lists=curves)
columnByCurve = StructuralFraming.ColumnByCurve(curve=transpose, level=removeItemAtIndex, structuralColumnType=n5_select_structural_column_types)

# group: Pedestal & 독립기초 모델링
firstItem = List.FirstItem(list=translate_2@L2)
elevation_4 = Level.Elevation(level=filterByBoolMask_2.in)
string_6 = StringInput("Foundation Thickness")
parameterByName_2 = Parameter.ParameterByName(element=n3_select_foundation_types, name=string_6)
value_2 = Parameter.Value(parameter=parameterByName_2)
add = elevation_4 + value_2
translate_3 = Geometry.Translate(geometry=firstItem, zTranslation=add, lacing=CrossProduct)
byStartPointEndPoint = Line.ByStartPointEndPoint(startPoint=translate_3, endPoint=firstItem, lacing=Shortest)
flatten_2 = List.Flatten(list=byStartPointEndPoint)
columnByCurve_2 = StructuralFraming.ColumnByCurve(curve=flatten_2, level=filterByBoolMask_2.in, structuralColumnType=n4_select_pedestal_types, lacing=CrossProduct)
flatten_3 = List.Flatten(list=translate_3)
byPointAndLevel = FamilyInstance.ByPointAndLevel(familyType=n3_select_foundation_types, point=flatten_3, level=filterByBoolMask_2.in, lacing=CrossProduct)
string_7 = StringInput("Height Offset From Level")
setParameterByName = Element.SetParameterByName(element=byPointAndLevel, parameterName=string_7, value=value_2, lacing=CrossProduct)

# group: 그리드 간 교차점으로 그리드 분할 => 보 Curve 작성
intersect_2 = Geometry.Intersect(geometry=join, other=pruneDuplicates, lacing=CrossProduct)
flatten_4 = List.Flatten(list=intersect_2@L3)
parameterAtPoint = Curve.ParameterAtPoint(curve=join, point=flatten_4, lacing=Shortest)
sort_2 = List.Sort(list=parameterAtPoint)
indexOf_2 = List.IndexOf(list=parameterAtPoint, element=sort_2, lacing=Shortest)
getItemAtIndex_6 = List.GetItemAtIndex(list=flatten_4, index=indexOf_2, lacing=Shortest)
byPoints_2 = PolyCurve.ByPoints(points=getItemAtIndex_6)
curves_2 = PolyCurve.Curves(polyCurve=byPoints_2)

# group: 보 패밀리 선택
n6_select_structural_framing = StructuralFramingTypes("H_SB_ACB_B600xH900")  # "6. Select : Structural Framing Types"; graph input

# group: 보 모델링
flatten_5 = List.Flatten(list=curves_2)
elevation_5 = Level.Elevation(level=restOfItems)
number_5 = DoubleInput(1)
round_6 = Math.Round(number=elevation_5, digits=number_5)
translate_4 = Geometry.Translate(geometry=flatten_5, zTranslation=round_6, lacing=CrossProduct)
transpose_2 = List.Transpose(lists=translate_4)
beamByCurve = StructuralFraming.BeamByCurve(curve=transpose_2, level=removeItemAtIndex, structuralFramingType=n6_select_structural_framing)
string_8 = StringInput("y Offset Value")
number_6 = DoubleInput(0)
setParameterByName_2 = Element.SetParameterByName(element=beamByCurve, parameterName=string_8, value=number_6, lacing=CrossProduct)

# group: 타이거더 Curve 작성
flatten_6 = List.Flatten(list=getItemAtIndex_6)
X_2 = Point.X(point=flatten_6)
round_7 = Math.Round(number=X_2)
maximumItem = List.MaximumItem(list=round_7)
allIndicesOf_5 = List.AllIndicesOf(list=round_7, item=maximumItem)
minimumItem = List.MinimumItem(list=round_7)
allIndicesOf_6 = List.AllIndicesOf(list=round_7, item=minimumItem)
Y_2 = Point.Y(point=flatten_6)
round_8 = Math.Round(number=Y_2)
maximumItem_2 = List.MaximumItem(list=round_8)
allIndicesOf_7 = List.AllIndicesOf(list=round_8, item=maximumItem_2)
minimumItem_2 = List.MinimumItem(list=round_8)
allIndicesOf_8 = List.AllIndicesOf(list=round_8, item=minimumItem_2)
list_create = List.Create(item0=allIndicesOf_5, item1=allIndicesOf_6, item2=allIndicesOf_7, item3=allIndicesOf_8)
getItemAtIndex_7 = List.GetItemAtIndex(list=flatten_6, index=list_create)
pruneDuplicates_2 = Point.PruneDuplicates(points=getItemAtIndex_7@L2)
byPoints_3 = PolyCurve.ByPoints(points=pruneDuplicates_2)
curves_3 = PolyCurve.Curves(polyCurve=byPoints_3)

# group: TG 패밀리 선택
n7_select_tie_girder_types = StructuralFramingTypes("H_SB_ACB_TG_B400xH600")  # "7. Select : Tie Girder Types"; graph input

# group: 타이거더 모델링
firstItem_2 = List.FirstItem(list=removeItemAtIndex)
elevation_6 = Level.Elevation(level=firstItem_2)
translate_5 = Geometry.Translate(geometry=curves_3, zTranslation=elevation_6, lacing=CrossProduct)
beamByCurve_2 = StructuralFraming.BeamByCurve(curve=translate_5, level=firstItem_2, structuralFramingType=n7_select_tie_girder_types)

string_9 = StringInput("y Offset Value")
number_7 = DoubleInput(0)
setParameterByName_3 = Element.SetParameterByName(element=beamByCurve_2, parameterName=string_9, value=number_7, lacing=CrossProduct)

# group (continued): 타이거더 모델링
flatten_7 = List.Flatten(list=setParameterByName_3)
list_create_2 = List.Create(item0=flatten_7)

# group: 지붕 패밀리 선택
n1_select_roof_types = RoofTypes("H_RF_AMF_RC Roof Finish_WP_Insulation_Protection")  # "1. Select: Roof Types"; graph input

# group: 페데스탈 & 타이거더 형상 결합
flatten_8 = List.Flatten(list=columnByCurve_2)
firstItem_3 = List.FirstItem(list=flatten_7)
getCategory = Element.GetCategory(element=firstItem_3)
getIntersectingElementsOfCategory = Element.GetIntersectingElementsOfCategory(element=flatten_8, category=getCategory)
joinGeometry = Element.JoinGeometry(element=flatten_8, otherElement=getIntersectingElementsOfCategory)

# group: 기초(바닥) 패밀리 선택
n2_select_floor_types = FloorTypes("H_FL_AMF_RC Slab_T150")  # "2. Select : Floor Types"; graph input

# group: 바닥 및 지붕 모델링
solids = Element.Solids(element=columnByCurve_2)
flatten_9 = List.Flatten(list=solids)
byUnion = Solid.ByUnion(solids=flatten_9)
join_2 = List.Join()  # unwired: list0, list1, list2
combine = List.Combine(combineFunction=join_2, list0=columnByCurve, list1=getItemAtIndex_5, list2=setParameterByName_2)
solids_2 = Element.Solids(element=combine)
flatten_10 = List.Flatten(list=solids_2@L3)
byUnion_2 = Solid.ByUnion(solids=flatten_10)
join_3 = List.Join(list0=byUnion, list1=byUnion_2)
byGeometry = BoundingBox.ByGeometry(geom=join_3, lacing=Shortest)
toCuboid = BoundingBox.ToCuboid(boundingBox=byGeometry)
bySolid = PolySurface.BySolid(solid=toCuboid)
surfaces = PolySurface.Surfaces(polySurface=bySolid)
join_4 = List.Join()  # unwired: list0, list1
number_8 = DoubleInput(0.5)
normalAtParameter = Surface.NormalAtParameter(surface=surfaces, u=number_8, v=number_8)
Z_3 = Vector.Z(vector=normalAtParameter)
number_9 = DoubleInput(-1)
eq_5 = Z_3 == number_9
boolean_5 = BoolSelector(true)
allIndicesOf_9 = List.AllIndicesOf(list=eq_5, item=boolean_5, lacing=CrossProduct)
number_10 = DoubleInput(1)
eq_6 = Z_3 == number_10
allIndicesOf_10 = List.AllIndicesOf(list=eq_6, item=boolean_5, lacing=CrossProduct)
combine_2 = List.Combine(combineFunction=join_4, list0=allIndicesOf_9, list1=allIndicesOf_10)
removeItemAtIndex_2 = List.RemoveItemAtIndex(list=surfaces, indices=combine_2, lacing=Shortest)
flatten_11 = List.Flatten(list=removeItemAtIndex_2)
byJoinedSurfaces = PolySurface.ByJoinedSurfaces(surfaces=flatten_11)
getItemAtIndex_8 = List.GetItemAtIndex(list=surfaces, index=allIndicesOf_10, lacing=Shortest)
flatten_12 = List.Flatten(list=getItemAtIndex_8)
lastItem_2 = List.LastItem(list=flatten_12)
perimeterCurves = Surface.PerimeterCurves(surface=lastItem_2)
byOutlineTypeAndLevel = Roof.ByOutlineTypeAndLevel(outline=perimeterCurves, roofType=n1_select_roof_types, level=lastItem)
getItemAtIndex_9 = List.GetItemAtIndex(list=surfaces, index=allIndicesOf_9, lacing=Shortest)
flatten_13 = List.Flatten(list=getItemAtIndex_9)
restOfItems_2 = List.RestOfItems(list=flatten_13)
perimeterCurves_2 = Surface.PerimeterCurves(surface=restOfItems_2)
byOutlineTypeAndLevel_2 = Floor.ByOutlineTypeAndLevel(outlineCurves=perimeterCurves_2, floorType=n2_select_floor_types, level=removeItemAtIndex)

# group: 벽체 위치 업데이트 (바닥 Outline 정렬)
list_create_3 = List.Create()  # unwired: item0, item1, item2, item3
solids_3 = Element.Solids(element=getItemAtIndex_4)  # frozen
flatten_14 = List.Flatten(list=solids_3@L3)
centroid = Solid.Centroid(solid=flatten_14)
X_3 = Point.X(point=centroid)
round_9 = Math.Round(number=X_3)
minimumItem_3 = List.MinimumItem(list=round_9)
allIndicesOf_11 = List.AllIndicesOf(list=round_9, item=minimumItem_3, lacing=Shortest)
maximumItem_3 = List.MaximumItem(list=round_9)
allIndicesOf_12 = List.AllIndicesOf(list=round_9, item=maximumItem_3, lacing=Shortest)
Y_3 = Point.Y(point=centroid)
round_10 = Math.Round(number=Y_3)
minimumItem_4 = List.MinimumItem(list=round_10)
allIndicesOf_13 = List.AllIndicesOf(list=round_10, item=minimumItem_4, lacing=Shortest)
maximumItem_4 = List.MaximumItem(list=round_10)
allIndicesOf_14 = List.AllIndicesOf(list=round_10, item=maximumItem_4, lacing=Shortest)
combine_3 = List.Combine(combineFunction=list_create_3, list0=allIndicesOf_11, list1=allIndicesOf_12, list2=allIndicesOf_13, list3=allIndicesOf_14)
flatten_15 = List.Flatten(list=combine_3@L3)
getItemAtIndex_10 = List.GetItemAtIndex(list=getItemAtIndex_4, index=flatten_15, lacing=Shortest)
getLocation_2 = Element.GetLocation(element=getItemAtIndex_10)
getItemAtIndex_11 = List.GetItemAtIndex(list=centroid, index=flatten_15, lacing=Shortest)
closestPointTo = Geometry.ClosestPointTo(geometry=byJoinedSurfaces, other=getItemAtIndex_11)
X_4 = Point.X(point=closestPointTo)
getItemAtIndex_12 = List.GetItemAtIndex(list=flatten_14, index=flatten_15, lacing=Shortest)
closestPointTo_2 = Geometry.ClosestPointTo(geometry=getItemAtIndex_12, other=closestPointTo, lacing=Shortest)
X_5 = Point.X(point=closestPointTo_2)
sub = X_4 - X_5  # lacing=Shortest
Y_4 = Point.Y(point=closestPointTo)
Y_5 = Point.Y(point=closestPointTo_2)
sub_2 = Y_4 - Y_5  # lacing=Shortest
translate_6 = Geometry.Translate(geometry=getLocation_2, xTranslation=sub, yTranslation=sub_2, lacing=Shortest)
setLocation = Element.SetLocation(element=getItemAtIndex_10, geometry=translate_6, lacing=Shortest)

# group: 보 위치 업데이트 (바닥 Outline 정렬)
join_5 = List.Join(list0=list_create_2, list1=setParameterByName_2)  # frozen
list_create_4 = List.Create()  # unwired: item0, item1, item2, item3
getLocation_3 = Element.GetLocation(element=join_5)
number_11 = DoubleInput(0.5)
pointAtParameter_2 = Curve.PointAtParameter(curve=getLocation_3, param=number_11)
X_6 = Point.X(point=pointAtParameter_2)
round_11 = Math.Round(number=X_6)
minimumItem_5 = List.MinimumItem(list=round_11)
allIndicesOf_15 = List.AllIndicesOf(list=round_11, item=minimumItem_5, lacing=Shortest)
maximumItem_5 = List.MaximumItem(list=round_11)
allIndicesOf_16 = List.AllIndicesOf(list=round_11, item=maximumItem_5, lacing=Shortest)
Y_6 = Point.Y(point=pointAtParameter_2)
round_12 = Math.Round(number=Y_6)
minimumItem_6 = List.MinimumItem(list=round_12)
allIndicesOf_17 = List.AllIndicesOf(list=round_12, item=minimumItem_6, lacing=Shortest)
maximumItem_6 = List.MaximumItem(list=round_12)
allIndicesOf_18 = List.AllIndicesOf(list=round_12, item=maximumItem_6, lacing=Shortest)
combine_4 = List.Combine(combineFunction=list_create_4, list0=allIndicesOf_15, list1=allIndicesOf_16, list2=allIndicesOf_17, list3=allIndicesOf_18)
flatten_16 = List.Flatten(list=combine_4@L3)
getItemAtIndex_13 = List.GetItemAtIndex(list=join_5, index=flatten_16, lacing=Shortest)
string_10 = StringInput("y Offset Value")
boundingBox = Element.BoundingBox(element=join_5)
toCuboid_2 = BoundingBox.ToCuboid(boundingBox=boundingBox)
getItemAtIndex_14 = List.GetItemAtIndex(list=toCuboid_2, index=flatten_16, lacing=Shortest)
closestPointTo_3 = Geometry.ClosestPointTo(geometry=byJoinedSurfaces, other=getItemAtIndex_14)
closestPointTo_4 = Geometry.ClosestPointTo(geometry=getItemAtIndex_14, other=closestPointTo_3, lacing=Shortest)
byTwoPoints_2 = Vector.ByTwoPoints(start=closestPointTo_4, end=closestPointTo_3)
X_7 = Vector.X(vector=byTwoPoints_2)
number_12 = DoubleInput(-1)
mul_2 = X_7 * number_12
Y_7 = Vector.Y(vector=byTwoPoints_2)
add_2 = mul_2 + Y_7
setParameterByName_4 = Element.SetParameterByName(element=getItemAtIndex_13, parameterName=string_10, value=add_2)

# group: 지붕 레벨 조정
string_11 = StringInput("Base Offset From Level")
string_12 = StringInput("Thickness")
parameterByName_3 = Parameter.ParameterByName(element=byOutlineTypeAndLevel, name=string_12)
value_3 = Parameter.Value(parameter=parameterByName_3)
number_13 = DoubleInput(-1)
mul_3 = value_3 * number_13
setParameterByName_5 = Element.SetParameterByName(element=byOutlineTypeAndLevel, parameterName=string_11, value=mul_3)

# group: 객체 우선순위 설정
unjoinAllGeometry = Element.UnjoinAllGeometry(elements=setParameterByName_5)
lastItem_3 = List.LastItem(list=columnByCurve)
lastItem_4 = List.LastItem(list=setParameterByName_2)
join_6 = List.Join(list0=lastItem_3, list1=lastItem_4)
joinGeometry_2 = Element.JoinGeometry(element=unjoinAllGeometry, otherElement=join_6, lacing=CrossProduct)
flatten_17 = List.Flatten(list=joinGeometry_2@L2)
restOfItems_3 = List.RestOfItems(list=flatten_17@L2)
flatten_18 = List.Flatten(list=restOfItems_3)
setGeometryJoinOrder = Element.SetGeometryJoinOrder(cuttingElement=flatten_18, otherElement=unjoinAllGeometry, lacing=CrossProduct)
lastItem_5 = List.LastItem(list=getItemAtIndex_5)

# group: 객체 우선순위 설정
unjoinAllGeometry_2 = Element.UnjoinAllGeometry(elements=byOutlineTypeAndLevel_2)
join_7 = List.Join()  # unwired: list0, list1, list2
categories_4 = Categories("OST_Walls")
getIntersectingElementsOfCategory_2 = Element.GetIntersectingElementsOfCategory(element=byOutlineTypeAndLevel_2, category=categories_4)
categories_5 = Categories("OST_StructuralColumns")
getIntersectingElementsOfCategory_3 = Element.GetIntersectingElementsOfCategory(element=byOutlineTypeAndLevel_2, category=categories_5)
categories_6 = Categories("OST_StructuralFraming")
getIntersectingElementsOfCategory_4 = Element.GetIntersectingElementsOfCategory(element=byOutlineTypeAndLevel_2, category=categories_6)
combine_5 = List.Combine(combineFunction=join_7, list0=getIntersectingElementsOfCategory_2, list1=getIntersectingElementsOfCategory_3, list2=getIntersectingElementsOfCategory_4)
joinGeometry_3 = Element.JoinGeometry(element=unjoinAllGeometry_2, otherElement=combine_5)
lastItem_6 = List.LastItem(list=joinGeometry_3@L2)
firstItem_4 = List.FirstItem(list=joinGeometry_3@L2)
setGeometryJoinOrder_2 = Element.SetGeometryJoinOrder(cuttingElement=lastItem_6, otherElement=firstItem_4, lacing=CrossProduct)
