# Dynamo graph Bidding_Elements Join Order Organizer_1.0.0.dyn (Dynamo 2.16.1.2727)

setGeometryJoinOrder = Element.SetGeometryJoinOrder()  # unwired: cuttingElement, otherElement
joinGeometry = Element.JoinGeometry()  # unwired: element, otherElement
categories = Categories("OST_StructuralFoundation")
all_elements_of_category = ElementsOfCategory(Category=categories)
categories_2 = Categories("OST_StructuralColumns")
all_elements_of_category_2 = ElementsOfCategory(Category=categories_2)
categories_3 = Categories("OST_StructuralFraming")
all_elements_of_category_3 = ElementsOfCategory(Category=categories_3)
categories_4 = Categories("OST_Floors")
all_elements_of_category_4 = ElementsOfCategory(Category=categories_4)
categories_5 = Categories("OST_Roofs")
all_elements_of_category_5 = ElementsOfCategory(Category=categories_5)
custom_selection = CustomSelection("2. Pes & AG Columns", items={All at Once: ",0,1,2,3,4,5,6", 1. Fdn & Peds: ",0,1", 2. Pes & AG Columns: ",1,2", 3. Columns & Beams: ",3,4", 4. Columns & Floors: ",3,5", 5. Beams & Floors: ",4,5", 6. Columns & Roofs: ",3,6", 7. Beams & Roofs: ",4,6"})
python_script = Python(IN[0]=all_elements_of_category, IN[1]=all_elements_of_category_2, IN[2]=all_elements_of_category_3, IN[3]=all_elements_of_category_4, IN[4]=all_elements_of_category_5, IN[5]=custom_selection)  # CPython3
# ---------- python_script.python (152 lines) ----------
# Load the Python Standard and DesignScript Libraries
import sys
import clr
clr.AddReference('ProtoGeometry')
from Autodesk.DesignScript.Geometry import *

clr.AddReference('RevitNodes')
import Revit
clr.ImportExtensions(Revit.Elements)
from Revit import Elements

import os

#################################Module For Functional Programing#############################################
from functools import reduce
curry = lambda f: lambda a,*args: f(a, *args) if (len(args)) else lambda *args: f(a, *args)

filter = curry(filter)
map = curry(map)

def _take(length, iter):
    res = []
    for a in iter:
        res.append(a)
        if len(res) == length:
            return res
        
take = curry(_take)
reduce = curry(reduce)

go = lambda *args: reduce(lambda a,f: f(a), args) ## 함수도 축약 가능 ##
##############################################################################################################
def find_cwd():
    doc = Revit.Application.Document.Current
    filePath_string = doc.FilePath
    folderPath = filePath_string.split('\\')
    folderPath.pop(-1)
    folderPath_str = '\\'.join(folderPath)
    return folderPath_str
    
# The inputs to this node will be stored as a list in the IN variables.
dataEnteringNode = IN
joinMode = list(map(lambda x: int(x), filter(lambda x: x!="",IN[5].split(','))))

fdns = IN[0]
columns = IN[1]
ag_columns = \
    list(filter(lambda x: "UG" not in str(x.GetParameterValueByName("Type")), columns))
ug_columns = \
    list(filter(lambda x: "UG" in str(x.GetParameterValueByName("Type")), columns))
beams = IN[2]
floors = IN[3]
roofs = IN[4]

cwd = find_cwd()

catsList = [
    fdns,
    ug_columns,
    ag_columns,
    columns,
    beams,
    floors,
    roofs,
]

targetCats = list(map(lambda x: catsList[x], joinMode))
# Place your code below this line
def make_elementJoinLog(lst,title):
    f = open(f"{cwd}\\Element Join log_{title}.txt", 'w')
    for i in lst:
        f.write(i+'\n')
    f.close()

def set_joinOrder(cat1,cat2,title):
    res = []
    for i in cat1:
        for j in cat2:
            a = "_".join(i.GetParameterValueByName("Type").GetParameterValueByName("Type Name").split('_')[3:])
            b = "_".join(j.GetParameterValueByName("Type").GetParameterValueByName("Type Name").split('_')[3:])
            if i.AreJoined(j):
                Elements.Element.SetGeometryJoinOrder(i,j)
                resStr = f"[{a}, {b}] - join order complete!"
                res.append(resStr)
            else:
                try:
                    i.JoinGeometry(j)
                    Elements.Element.SetGeometryJoinOrder(i,j)
                    resStr = f"[{a}, {b}] - newely joined and order complete!"
                    res.append(resStr)
                except:
                    resStr = f"[{a}, {b}] - nothing happened!"
                    res.append(resStr)
    make_elementJoinLog(res,title)
    return res

def set_columnJoinOrder(cat1,cat2,title):
    res = []
    for i in cat1:
        for j in cat2:
            a = i.GetParameterValueByName("Column Location Mark")
            b = j.GetParameterValueByName("Column Location Mark")
            if a == b:
                if i.AreJoined(j):
                    Elements.Element.SetGeometryJoinOrder(i,j)
                    resStr = f"[UG:{a}, AG:{b}] - join order complete!"
                    res.append(resStr)
                else:
                    try:
                        i.JoinGeometry(j)
                        Elements.Element.SetGeometryJoinOrder(i,j)
                        resStr = f"[UG:{a}, AG:{b}] - newely joined and order complete!"
                        res.append(resStr)
                    except:
                        resStr = f"[UG:{a}, AG:{b}] - nothing happened!"
                        res.append(resStr)
    make_elementJoinLog(res,title)
    return res

def set_joinBySelection(targetCats,joinMode):
    catsNameList = [
    "fdns",
    "ug_cols",
    "ag_cols",
    "cols",
    "beams",
    "floors",
    "roofs",
    ]
    title = list(map(lambda x: catsNameList[x], joinMode))
    if len(title) == 2:
        title_str = '&'.join(title)
        [cat1,cat2] = [*targetCats]
        res = set_joinOrder(cat1,cat2,title_str)
    elif title == ["ug_cols","ag_cols"]:
        title_str = '&'.join(title)
        [cat1,cat2] = [*targetCats]
        res = set_columnJoinOrder(cat1,cat2,title_str)
    
    return res

#result = {
#    "Fdns & Peds Result": set_joinOrder(fdns, ug_columns,"fdn&ped"),
#    "Peds & Columns Result": set_columnJoinOrder(ug_columns,ag_columns,"ped&col"),
#    "Columns & Beams": set_joinOrder(columns, beams, "col&beam"),
#    }

result = set_joinBySelection(targetCats,joinMode)
# Assign your output to the OUT variable.


OUT = result
# ----------------------------------------
areJoined = Element.AreJoined()  # unwired: element, otherElement
parameters = Element.Parameters()  # unwired: element
parameters_2 = Element.Parameters(element=all_elements_of_category)
code_block = CodeBlock(i=parameters_2) { i[0][13]; }
value = Parameter.Value(parameter=code_block)
parameters_3 = Element.Parameters(element=value)
