# Dynamo graph Bidding_Room Size_Injector_1.0.0.dyn (Dynamo 2.16.1.2727)
# author: MK Jang
# Check Builing's all rooms size and inject the sizes into schedule

categories = Categories("OST_Rooms")
all_elements_of_category = ElementsOfCategory(Category=categories)
code_block = CodeBlock { "Name"; }
getParameterValueByName = Element.GetParameterValueByName(element=all_elements_of_category, parameterName=code_block)
code_block_2 = CodeBlock { "MECHANICAL ROOM"; }
contains = String.Contains(string=getParameterValueByName, searchFor=code_block_2)
filterByBoolMask = List.FilterByBoolMask(list=all_elements_of_category, mask=contains)
code_block_3 = CodeBlock(i=all_elements_of_category) { i; }
code_block_4 = CodeBlock()
# ---------- code_block_4.designscript (5 lines) ----------
[
"H_Room W",
"H_Room L",
"H_Room H or CH"
];
# ----------------------------------------

# group: check Rooms Width / Length
coreCenterBoundary = Room.CoreCenterBoundary(room=all_elements_of_category)
byJoinedCurves = PolyCurve.ByJoinedCurves(curves=coreCenterBoundary)
flatten = List.Flatten(list=byJoinedCurves)
byPatch = Surface.ByPatch(closedCurve=flatten)
code_block_5 = CodeBlock { 100; }
thicken = Surface.Thicken(surface=byPatch, thickness=code_block_5)
boundingBox = Geometry.BoundingBox(geometry=thicken)
toCuboid = BoundingBox.ToCuboid(boundingBox=boundingBox)
width = Cuboid.Width(cuboid=toCuboid)
length = Cuboid.Length(cuboid=toCuboid)

# group: check Rooms Height
geometry = Element.Geometry(element=all_elements_of_category)
flatten_2 = List.Flatten(list=geometry)
boundingBox_2 = Geometry.BoundingBox(geometry=flatten_2)
toCuboid_2 = BoundingBox.ToCuboid(boundingBox=boundingBox_2)
height = Cuboid.Height(cuboid=toCuboid_2)

room_size_정리 = Python(IN[0]=width, IN[1]=length, IN[2]=height)  # CPython3
# ---------- room_size_정리.python (19 lines) ----------
# Load the Python Standard and DesignScript Libraries
import sys
import clr
clr.AddReference('ProtoGeometry')
from Autodesk.DesignScript.Geometry import *

import math

# The inputs to this node will be stored as a list in the IN variables.
dataEnteringNode = IN
[ws, ls, hs] = [IN[0], IN[1], IN[2]]

# Place your code below this line

chk_size = lambda y: map(lambda x: math.floor(x/100)*100, y)
chk_height = lambda y: map(lambda x: math.floor(x/100)*100, y)
res = [chk_size(ws), chk_size(ls), chk_height(hs)]
# Assign your output to the OUT variable.
OUT = list(zip(*res))
# ----------------------------------------
rooms_setparameter = Python(IN[0]=code_block_3, IN[1]=code_block_4, IN[2]=room_size_정리)  # CPython3
# ---------- rooms_setparameter.python (56 lines) ----------
# Load the Python Standard and DesignScript Libraries
import sys
import clr
clr.AddReference('ProtoGeometry')
from Autodesk.DesignScript.Geometry import *

from functools import reduce

#################################Module For Functional Programing#############################################
curry = lambda f: lambda a,*args: f(a, *args) if (len(args)) else lambda *args: f(a, *args)

filter = curry(filter)
map = curry(map)

def _take(length, iter):
    res = []
    for a in iter:
        res.append(a)
        if len(res) == length:
            return res
        
take = curry(_take)
reduce = curry(reduce)

go = lambda *args: reduce(lambda a,f: f(a), args) ## 함수도 축약 가능 ##
##############################################################################################################

# The inputs to this node will be stored as a list in the IN variables.
dataEnteringNode = IN
rooms = IN[0]
params = IN[1]
sizes = IN[2]
# Place your code below this line

size_withParams = map(lambda x: dict(zip(params, x)) , sizes)
rooms_withSizes = list(zip(rooms, size_withParams))

setParamsAtAllRooms = lambda col: go\
(
    col,
    map(setParamsAtOneRoom),
    
)

def setParamsAtOneRoom(room_withSizes):
    room = room_withSizes[0]
    sizeDic = room_withSizes[1]
    paramName_andSizes = sizeDic.items()
    
    setParamRoom = lambda x: room.SetParameterByName(x[0],x[1])
    
    return map(setParamRoom,paramName_andSizes)
    

# Assign your output to the OUT variable.
OUT = setParamsAtAllRooms(rooms_withSizes)
# ----------------------------------------
rooms_boundary_at_corecenter = Python(IN[0]=all_elements_of_category)  # CPython3
# ---------- rooms_boundary_at_corecenter.python (63 lines) ----------
# Load the Python Standard and DesignScript Libraries
import sys
import clr
clr.AddReference('ProtoGeometry')
from Autodesk.DesignScript.Geometry import *

from functools import reduce

#################################Module For Functional Programing#############################################
curry = lambda f: lambda a,*args: f(a, *args) if (len(args)) else lambda *args: f(a, *args)

filter = curry(filter)
map = curry(map)

def _take(length, iter):
    res = []
    for a in iter:
        res.append(a)
        if len(res) == length:
            return res
        
take = curry(_take)
reduce = curry(reduce)

go = lambda *args: reduce(lambda a,f: f(a), args) ## 함수도 축약 가능 ##
##############################################################################################################

# The inputs to this node will be stored as a list in the IN variables.
dataEnteringNode = IN
rooms = IN[0]

# Place your code below this line



def findBtmSrfAtSolid(solid):
    srfs = solid.Explode()
    findBtm= lambda col: go\
    (
        col,
        filter(lambda x: round(x.NormalAtParameter(0.5,0.5).Z, 2)==-1)
        
    )
    return list(findBtm(srfs))[0]
    
def findOffsetBtmSrf(solid):
    btmSrf_perimeter = findBtmSrfAtSolid(solid).PerimeterCurves()
    polyBd = PolyCurve.ByJoinedCurves(btmSrf_perimeter)
    offset = polyBd.OffsetMany(-10.0,False,None)
    return offset

def findCoreCenterBoundaryAtOneRoom(room):
    room_src_bd = room.CoreCenterBoundary
    
    roomSolid_btmSrf = findBtmSrfAtSolid(room.Geometry()[0])
    offset_peri = findOffsetBtmSrf(room.Geometry()[0])[0]
    offset_srf = Surface.ByPatch(offset_peri)
    
    return room_src_bd, offset_srf
    

# Assign your output to the OUT variable.
OUT = findCoreCenterBoundaryAtOneRoom(rooms[25])
# ----------------------------------------
watch_3d = Watch3D()  # unwired: arg0
categories_2 = Categories("OST_GenericModel")
categories_3 = Categories("OST_Materials")
all_elements_of_category_2 = ElementsOfCategory(Category=categories_3)
code_block_6 = CodeBlock(i=all_elements_of_category_2) { i[0]; }
code_block_7 = CodeBlock { "Rooms_directShape"; }
byGeometry = DirectShape.ByGeometry(geometry=flatten_2, category=categories_2, material=code_block_6, name=code_block_7)
