# Dynamo graph Finish Style_injector_1.0.1.dyn (Dynamo 2.16.1.2727)
# author: MK Jang
# Inject Finish Style Data in Building List into Revit Key Schedule

# group: Filtering Finish Style Schedule
categories = Categories("OST_Schedules")
all_elements_of_category = ElementsOfCategory(Category=categories)
name = Element.Name(element=all_elements_of_category)
isfinishstyleschedule = Python(IN[0]=name)  # CPython3
# ---------- isfinishstyleschedule.python (45 lines) ----------
# Load the Python Standard and DesignScript Libraries
import sys
import clr
clr.AddReference('ProtoGeometry')
from Autodesk.DesignScript.Geometry import *

# The inputs to this node will be stored as a list in the IN variables.
dataEnteringNode = IN
sch_names_list = IN[0]
# Place your code below this line
tgtList = [
    "Floor Finish Style",
    "Base Finish Style",
    "Wall Finish Style",
    "Ceiling Finish Style",
    "Wall Style",
    "Roof Style",
    "Door Style",
    "Window Style",
    ]
tgtStr = "Style"

def isInStr_tgt(inStr,tgtStr):
    if tgtStr in inStr:
        res = True
    else:
        res = False
    return res

def isInStr_tgtList(inStr,tgtList):
    tmp = []
    for tgt in tgtList:
        if tgt in inStr:
            tmp.append(True)
        else:
            tmp.append(False)
    return any(tmp)
        

res = list(map(lambda x: isInStr_tgt(x, tgtStr) , sch_names_list))
    


# Assign your output to the OUT variable.
OUT = res
# ----------------------------------------
filterByBoolMask = List.FilterByBoolMask(list=all_elements_of_category, mask=isfinishstyleschedule)

name_2 = Element.Name(element=filterByBoolMask.in)
sortByKey = List.SortByKey(list=filterByBoolMask.in, keys=name_2)
finish_category_선택 = CustomSelection("H_Window Style", items={A_Floor Finish: "0", B_Base Finish: "1", C_Wall Finish: "2", D_Ceiling Finish: "3", E_Wall Style: "4", F_Roof Style: "5", G_Door Style: "6", H_Window Style: "7"})  # graph input
getItemAtIndex = List.GetItemAtIndex(list=sortByKey.sortedList, index=finish_category_선택)

# group: Import From Excel
빌딩리스트_경로 = Filename("20231214_Finish Style injector update 요청\플랜트건축팀_BIM_팀 표준_Building List_Rev.B_박기범_2023.12.08.xlsx")  # graph input
file_from_path = FileObject(path=빌딩리스트_경로)
code_block = CodeBlock()
# ---------- code_block.designscript (7 lines) ----------
[
"Int Finish Style No"
,"Wall Style No"
,"Roof Style No"
,"Door Style No"
,"Window Style No"
];
# ----------------------------------------
boolean = BoolSelector(true)
importExcel = Data.ImportExcel(file=file_from_path, sheetName=code_block, showExcel=boolean)

code_block_2 = CodeBlock(i=importExcel) { i[0]; i[1]; i[2]; i[3]; i[4]; }
code_block_3 = CodeBlock()
# ---------- code_block_3.designscript (3 lines) ----------
["Floor", "Base", "Wall", "Ceiling", "Exterior Wall", "Roof"];
5;
 // 시작row 인덱스;
# ----------------------------------------
parse_int_finish_style_no_시트_as = Python(IN[0]=code_block_2.out0, IN[1]=code_block_3.out0, IN[2]=code_block_3.out1)  # "Parse_Int Finish Style No 시트(as dict)"; CPython3
# ---------- parse_int_finish_style_no_시트_as.python (156 lines) ----------
# Load the Python Standard and DesignScript Libraries
import sys
import clr
clr.AddReference('ProtoGeometry')
from Autodesk.DesignScript.Geometry import *

from functools import reduce
from functools import partial
from itertools import chain

import re
# The inputs to this node will be stored as a list in the IN variables.
dataEnteringNode = IN
wholeDatas = IN[0]
dataStartRowIdx = IN[2]
sheet = wholeDatas[dataStartRowIdx:]
row_sep_criteria = IN[1]
#headers = IN[3]

# Place your code below this line

def find_IsInStr(target, str):
    if target == None or str == None:
        pass
    else:
        res = target in str
        return res

def find_IsIn_list(target, lst):
    if target == None or str == None:
        pass
    else:
        res = target in lst
        return res

def find_range_by_columnItem(db, col_idx, sep_rule):
    tdb = list(map(lambda x: x[col_idx], db))
    last_idx_tdb = len(tdb)-1
    tdb_enum = enumerate(tdb)
    res = list(filter(lambda x: find_IsInStr(sep_rule, x[1]), tdb_enum))
    endidxs_tmp= list(map(lambda x: x[0]-1,res))
    endidxs_tmp.pop(0)
    endidxs = endidxs_tmp + [last_idx_tdb]
    famTypeNames = list(map(lambda x: x[1],res))
    famTypeNamesIdxs = list(map(lambda x: x[0],res))
    rangeSttIdxs = list(map(lambda x: x[0]+1,res))
    rangeEndIdxs = endidxs
    result = dict(zip(famTypeNames, zip(famTypeNamesIdxs, zip(rangeSttIdxs,rangeEndIdxs))))
    return result

def find_range_by_columnItem_Eq(db, col_idx, row_sep_criteria):
    tdb = list(map(lambda x: x[col_idx], db))
    last_idx_tdb = len(tdb)-1
    tdb_enum = enumerate(tdb)
    res = list(filter(lambda x: find_IsIn_list(x[1], row_sep_criteria), tdb_enum))
    endidxs_tmp= list(map(lambda x: x[0]-1,res))
    endidxs_tmp.pop(0)
    endidxs = endidxs_tmp + [last_idx_tdb]
    famTypeNames = list(map(lambda x: x[1],res))
    famTypeNamesIdxs = list(map(lambda x: x[0],res))
    rangeSttIdxs = list(map(lambda x: x[0]+1,res))
    rangeEndIdxs = endidxs
    result = dict(zip(famTypeNames, zip(famTypeNamesIdxs, zip(rangeSttIdxs,rangeEndIdxs))))
    return result
    
def find_headersAtSheet(sheet):
    headers_sheet = map(lambda x: [x[1].replace("\n",""),x[0]], filter(lambda x: x[1] != None, enumerate(sheet[1])))
    
    return dict(headers_sheet)

def find_rangesAtSheet(sheet, hdrs_withIdx, trgt_hdr, trgt_str):
    return find_range_by_columnItem(sheet, hdrs_withIdx[trgt_hdr], trgt_str)

def find_rangesAtSheet_eq(sheet, hdrs_withIdx, trgt_hdr, row_sep_criteria):
    res = find_range_by_columnItem_Eq(sheet, hdrs_withIdx[trgt_hdr], row_sep_criteria)
    
    return res

headers = sorted(find_headersAtSheet(sheet),key=lambda x:find_headersAtSheet(sheet)[x])
del headers[0]

def get_DataOnRangesAtSheet(sheet, row_sep_criteria):
    hdrs_withIdx = find_headersAtSheet(sheet)
    rangesATSheet = find_rangesAtSheet_eq(sheet, hdrs_withIdx, "Floor", row_sep_criteria)
    title_idx = map(lambda x: x[0], rangesATSheet.values())
    catType_colDatas = list(map(lambda x: x[hdrs_withIdx["Floor"]], sheet))
    catTypes = list(map(lambda x: catType_colDatas[x], title_idx))
    rgs_v = list(map(lambda x: x[1], rangesATSheet.values()))
    rgs_k = list(map(lambda x: x, rangesATSheet.keys()))
    
    
    datas_allCatType = list(map(lambda x: sheet[x[0]-1:x[1]], rgs_v))
    
    def setDict_OnEachCatType(data_catType):
        cat_hdrsRow = data_catType.pop(0)
        eff_cat_hdrs = list(filter(lambda x: x!=None, cat_hdrsRow[2:]))
        
        cat_hdrs_withIdx = dict(map(lambda x: [x[1].replace("\n",""),x[0]], filter(lambda x: x[1] != None, enumerate(cat_hdrsRow))))
        
        hdrs_v = list(cat_hdrs_withIdx.values())
        hdrs_k = list(cat_hdrs_withIdx.keys())
        eff_hdrs_v = hdrs_v[1:]
        eff_hdrs_k = hdrs_k[1:]
    
        ## 문자 1~2자리 + 숫자 2자리
        p = re.compile('[A-Z]{1,3}\d{2}')
        
        
        data_catType_noneless = list(filter(lambda x: x[cat_hdrs_withIdx["Style No (Key Name)"]] != None, data_catType))
        data_catType_onlyStyleNo = list(filter(lambda x: p.match(str(x[cat_hdrs_withIdx["Style No (Key Name)"]])), data_catType))
        catTypeName = list(map(lambda x: x[cat_hdrs_withIdx["Style No (Key Name)"]], data_catType_onlyStyleNo))
        ### WM row 별 header명 과 짝짓기
        data_withHdrsIdx = list(map(lambda y: list(map(lambda x: y[x], eff_hdrs_v)), data_catType_onlyStyleNo))
        dict_ = list(map(lambda x: dict(zip(eff_hdrs_k, x)), data_withHdrsIdx))
        dicts_final = list(map(lambda y: dict(filter(lambda x: x[1]!=None, y.items())),dict_))
        
        for oneDict in dicts_final:
            keys = oneDict.keys()
            for i in hdrs_k:
                if i not in keys:
                    oneDict[i] = ""

        return [eff_cat_hdrs, dict(zip(catTypeName,dicts_final))]
    
    return dict(zip(row_sep_criteria, map(setDict_OnEachCatType, datas_allCatType)))
    

dictsAIO = get_DataOnRangesAtSheet(sheet, row_sep_criteria)

def make_finalForm_forIntFinishStyle(dictsAIO):
    infFinish_order = ["Floor", "Base", "Wall", "Ceiling"]
    
    final_output = []
    for i in infFinish_order:
        keys = dictsAIO[i][0]
        dicts = dictsAIO[i][1:]
        
        for j in dicts:
            dd = j.values()
            tmp = []
            for d in dd:
                tmp2 = []
                for k in keys:
                    tmp2.append(d[k])
                tmp.append(tmp2)
        final_output.append(tmp)
    return final_output 

# Assign your output to the OUT variable.

OUT = make_finalForm_forIntFinishStyle(dictsAIO)

#hdrs_withIdx = find_headersAtSheet(sheet)
#hdrs_v = list(hdrs_withIdx.values())
#hdrs_k = list(hdrs_withIdx.keys())
#OUT = hdrs_k
# ----------------------------------------
code_block_4 = CodeBlock()
# ---------- code_block_4.designscript (3 lines) ----------
["Exterior Wall", "Interior Wall"];
5;
 // 시작row 인덱스;
# ----------------------------------------
parse_wall_style_no_시트_as_dict = Python(IN[0]=code_block_2.out1, IN[1]=code_block_4.out0, IN[2]=code_block_4.out1)  # CPython3
# ---------- parse_wall_style_no_시트_as_dict.python (166 lines) ----------
# Load the Python Standard and DesignScript Libraries
import sys
import clr
clr.AddReference('ProtoGeometry')
from Autodesk.DesignScript.Geometry import *

from functools import reduce
from functools import partial
from itertools import chain

import re
# The inputs to this node will be stored as a list in the IN variables.
dataEnteringNode = IN
wholeDatas = IN[0]
dataStartRowIdx = IN[2]
sheet = wholeDatas[dataStartRowIdx:]
row_sep_criteria = IN[1]
#headers = IN[3]

# Place your code below this line

def find_IsInStr(target, str):
    if target == None or str == None:
        pass
    else:
        res = target in str
        return res

def find_IsIn_list(target, lst):
    if target == None or str == None:
        pass
    else:
        res = target in lst
        return res

def find_range_by_columnItem(db, col_idx, sep_rule):
    tdb = list(map(lambda x: x[col_idx], db))
    last_idx_tdb = len(tdb)-1
    tdb_enum = enumerate(tdb)
    res = list(filter(lambda x: find_IsInStr(sep_rule, x[1]), tdb_enum))
    endidxs_tmp= list(map(lambda x: x[0]-1,res))
    endidxs_tmp.pop(0)
    endidxs = endidxs_tmp + [last_idx_tdb]
    famTypeNames = list(map(lambda x: x[1],res))
    famTypeNamesIdxs = list(map(lambda x: x[0],res))
    rangeSttIdxs = list(map(lambda x: x[0]+1,res))
    rangeEndIdxs = endidxs
    result = dict(zip(famTypeNames, zip(famTypeNamesIdxs, zip(rangeSttIdxs,rangeEndIdxs))))
    return result

def find_range_by_columnItem_Eq(db, col_idx, row_sep_criteria):
    tdb = list(map(lambda x: x[col_idx], db))
    last_idx_tdb = len(tdb)-1
    tdb_enum = enumerate(tdb)
    res = list(filter(lambda x: find_IsIn_list(x[1], row_sep_criteria), tdb_enum))
    endidxs_tmp= list(map(lambda x: x[0]-1,res))
    endidxs_tmp.pop(0)
    endidxs = endidxs_tmp + [last_idx_tdb]
    famTypeNames = list(map(lambda x: x[1],res))
    famTypeNamesIdxs = list(map(lambda x: x[0],res))
    rangeSttIdxs = list(map(lambda x: x[0]+1,res))
    rangeEndIdxs = endidxs
    result = dict(zip(famTypeNames, zip(famTypeNamesIdxs, zip(rangeSttIdxs,rangeEndIdxs))))
    return result
    
def find_headersAtSheet(sheet):
    headers_sheet = map(lambda x: [x[1].replace("\n",""),x[0]], filter(lambda x: x[1] != None, enumerate(sheet[1])))
    
    return dict(headers_sheet)

def find_rangesAtSheet(sheet, hdrs_withIdx, trgt_hdr, trgt_str):
    return find_range_by_columnItem(sheet, hdrs_withIdx[trgt_hdr], trgt_str)

def find_rangesAtSheet_eq(sheet, hdrs_withIdx, trgt_hdr, row_sep_criteria):
    res = find_range_by_columnItem_Eq(sheet, hdrs_withIdx[trgt_hdr], row_sep_criteria)
    
    return res

headers = sorted(find_headersAtSheet(sheet),key=lambda x:find_headersAtSheet(sheet)[x])
del headers[0]

def get_DataOnRangesAtSheet(sheet, row_sep_criteria):
    hdrs_withIdx = find_headersAtSheet(sheet)
    rangesATSheet = find_rangesAtSheet_eq(sheet, hdrs_withIdx, "Exterior Wall", row_sep_criteria)
    title_idx = map(lambda x: x[0], rangesATSheet.values())
    catType_colDatas = list(map(lambda x: x[hdrs_withIdx["Exterior Wall"]], sheet))
    catTypes = list(map(lambda x: catType_colDatas[x], title_idx))
    rgs_v = list(map(lambda x: x[1], rangesATSheet.values()))
    rgs_k = list(map(lambda x: x, rangesATSheet.keys()))
    
    datas_allCatType_withSubHdrs = list(map(lambda x: sheet[x[0]-1:x[1]], rgs_v))
    def remove_elem_atIdx(lst, idx):
        del lst[idx]
        return lst 
    datas_allCatType = list(map(lambda x: remove_elem_atIdx(x,1), datas_allCatType_withSubHdrs))
    
    def setDict_OnEachCatType(data_catType):
        cat_hdrsRow = data_catType.pop(0)
        eff_cat_hdrs = list(filter(lambda x: x!=None, cat_hdrsRow[2:]))
        
        cat_hdrs_withIdx_all = dict(map(lambda x: [x[1].replace("\n",""),x[0]], filter(lambda x: x[1] != None, enumerate(cat_hdrsRow))))
        
        hdrs_v = list(cat_hdrs_withIdx_all.values())
        hdrs_k = list(cat_hdrs_withIdx_all.keys())
        eff_hdrs_v = hdrs_v[1:]
        eff_hdrs_k = hdrs_k[1:]
        cat_hdrs_withIdx_originName = dict(list(zip(eff_hdrs_k, eff_hdrs_v)))
        
        cat_hdrs_withIdx = { k.replace(' (Key Name)', ''): v for k, v in cat_hdrs_withIdx_originName.items() }
        
                    
        
        ## 문자 1~2자리 + 숫자 2자리
        p = re.compile('[A-Z]{1,3}\d{2}')
        
        
        data_catType_noneless = list(filter(lambda x: x[cat_hdrs_withIdx["Style No"]] != None, data_catType))
        data_catType_onlyStyleNo = list(filter(lambda x: p.match(str(x[cat_hdrs_withIdx["Style No"]])), data_catType))
        catTypeName = list(map(lambda x: x[cat_hdrs_withIdx["Style No"]], data_catType_onlyStyleNo))
        #### WM row 별 header명 과 짝짓기
        data_withHdrsIdx = list(map(lambda y: list(map(lambda x: y[x], eff_hdrs_v)), data_catType_onlyStyleNo))
        dict_ = list(map(lambda x: dict(zip(eff_hdrs_k, x)), data_withHdrsIdx))
        dicts_final = list(map(lambda y: dict(filter(lambda x: x[1]!=None, y.items())),dict_))

        for oneDict in dicts_final:
            keys = oneDict.keys()
            for i in hdrs_k:
                if i not in keys:
                    oneDict[i] = ""

        return [eff_cat_hdrs, dict(zip(catTypeName,dicts_final))]
    
    return dict(zip(row_sep_criteria, map(setDict_OnEachCatType, datas_allCatType)))
    

dictsAIO = get_DataOnRangesAtSheet(sheet, row_sep_criteria)

def make_finalForm_forIntFinishStyle(dictsAIO):
    #infFinish_order = ["Floor", "Base", "Wall", "Ceiling"]
    
    final_output = []

    styleTypes = dictsAIO.values()
    for styleType in styleTypes:
        keys = styleType[0]
        dd = styleType[1:][0].values()
        tmp = []
        for i in dd:
            tmp = []
            for k in keys:
                tmp.append(i[k])
            final_output.append(tmp)


    return final_output

# Assign your output to the OUT variable.

OUT = make_finalForm_forIntFinishStyle(dictsAIO)

#hdrs_withIdx = find_headersAtSheet(sheet)
#hdrs_v = list(hdrs_withIdx.values())
#hdrs_k = list(hdrs_withIdx.keys())

#rangesATSheet = find_rangesAtSheet_eq(sheet, hdrs_withIdx, "Exterior Wall", row_sep_criteria)
#OUT = rangesATSheet
# ----------------------------------------
list_create = List.Create(item0=parse_wall_style_no_시트_as_dict)
code_block_5 = CodeBlock()
# ---------- code_block_5.designscript (3 lines) ----------
["Concrete Roof", "Cladding Roof"];
5;
 // 시작row 인덱스;
# ----------------------------------------
parse_roof_style_no_시트_as_dict = Python(IN[0]=code_block_2.out2, IN[1]=code_block_5.out0, IN[2]=code_block_5.out1)  # CPython3
# ---------- parse_roof_style_no_시트_as_dict.python (166 lines) ----------
# Load the Python Standard and DesignScript Libraries
import sys
import clr
clr.AddReference('ProtoGeometry')
from Autodesk.DesignScript.Geometry import *

from functools import reduce
from functools import partial
from itertools import chain

import re
# The inputs to this node will be stored as a list in the IN variables.
dataEnteringNode = IN
wholeDatas = IN[0]
dataStartRowIdx = IN[2]
sheet = wholeDatas[dataStartRowIdx:]
row_sep_criteria = IN[1]
#headers = IN[3]

# Place your code below this line

def find_IsInStr(target, str):
    if target == None or str == None:
        pass
    else:
        res = target in str
        return res

def find_IsIn_list(target, lst):
    if target == None or str == None:
        pass
    else:
        res = target in lst
        return res

def find_range_by_columnItem(db, col_idx, sep_rule):
    tdb = list(map(lambda x: x[col_idx], db))
    last_idx_tdb = len(tdb)-1
    tdb_enum = enumerate(tdb)
    res = list(filter(lambda x: find_IsInStr(sep_rule, x[1]), tdb_enum))
    endidxs_tmp= list(map(lambda x: x[0]-1,res))
    endidxs_tmp.pop(0)
    endidxs = endidxs_tmp + [last_idx_tdb]
    famTypeNames = list(map(lambda x: x[1],res))
    famTypeNamesIdxs = list(map(lambda x: x[0],res))
    rangeSttIdxs = list(map(lambda x: x[0]+1,res))
    rangeEndIdxs = endidxs
    result = dict(zip(famTypeNames, zip(famTypeNamesIdxs, zip(rangeSttIdxs,rangeEndIdxs))))
    return result

def find_range_by_columnItem_Eq(db, col_idx, row_sep_criteria):
    tdb = list(map(lambda x: x[col_idx], db))
    last_idx_tdb = len(tdb)-1
    tdb_enum = enumerate(tdb)
    res = list(filter(lambda x: find_IsIn_list(x[1], row_sep_criteria), tdb_enum))
    endidxs_tmp= list(map(lambda x: x[0]-1,res))
    endidxs_tmp.pop(0)
    endidxs = endidxs_tmp + [last_idx_tdb]
    famTypeNames = list(map(lambda x: x[1],res))
    famTypeNamesIdxs = list(map(lambda x: x[0],res))
    rangeSttIdxs = list(map(lambda x: x[0]+1,res))
    rangeEndIdxs = endidxs
    result = dict(zip(famTypeNames, zip(famTypeNamesIdxs, zip(rangeSttIdxs,rangeEndIdxs))))
    return result
    
def find_headersAtSheet(sheet):
    headers_sheet = map(lambda x: [x[1].replace("\n",""),x[0]], filter(lambda x: x[1] != None, enumerate(sheet[1])))
    
    return dict(headers_sheet)

def find_rangesAtSheet(sheet, hdrs_withIdx, trgt_hdr, trgt_str):
    return find_range_by_columnItem(sheet, hdrs_withIdx[trgt_hdr], trgt_str)

def find_rangesAtSheet_eq(sheet, hdrs_withIdx, trgt_hdr, row_sep_criteria):
    res = find_range_by_columnItem_Eq(sheet, hdrs_withIdx[trgt_hdr], row_sep_criteria)
    
    return res

headers = sorted(find_headersAtSheet(sheet),key=lambda x:find_headersAtSheet(sheet)[x])
del headers[0]

def get_DataOnRangesAtSheet(sheet, row_sep_criteria):
    hdrs_withIdx = find_headersAtSheet(sheet)
    rangesATSheet = find_rangesAtSheet_eq(sheet, hdrs_withIdx, "Concrete Roof", row_sep_criteria)
    title_idx = map(lambda x: x[0], rangesATSheet.values())
    catType_colDatas = list(map(lambda x: x[hdrs_withIdx["Concrete Roof"]], sheet))
    catTypes = list(map(lambda x: catType_colDatas[x], title_idx))
    rgs_v = list(map(lambda x: x[1], rangesATSheet.values()))
    rgs_k = list(map(lambda x: x, rangesATSheet.keys()))
    
    datas_allCatType_withSubHdrs = list(map(lambda x: sheet[x[0]-1:x[1]], rgs_v))
    def remove_elem_atIdx(lst, idx):
        del lst[idx]
        return lst 
    datas_allCatType = list(map(lambda x: remove_elem_atIdx(x,1), datas_allCatType_withSubHdrs))
    
    def setDict_OnEachCatType(data_catType):
        cat_hdrsRow = data_catType.pop(0)
        eff_cat_hdrs = list(filter(lambda x: x!=None, cat_hdrsRow[2:]))
        
        cat_hdrs_withIdx_all = dict(map(lambda x: [x[1].replace("\n",""),x[0]], filter(lambda x: x[1] != None, enumerate(cat_hdrsRow))))
        
        hdrs_v = list(cat_hdrs_withIdx_all.values())
        hdrs_k = list(cat_hdrs_withIdx_all.keys())
        eff_hdrs_v = hdrs_v[1:]
        eff_hdrs_k = hdrs_k[1:]
        cat_hdrs_withIdx_originName = dict(list(zip(eff_hdrs_k, eff_hdrs_v)))
        
        cat_hdrs_withIdx = { k.replace(' (Key Name)', ''): v for k, v in cat_hdrs_withIdx_originName.items() }
        
                    
        
        ## 문자 1~2자리 + 숫자 2자리
        p = re.compile('[A-Z]{1,3}\d{2}')
        
        
        data_catType_noneless = list(filter(lambda x: x[cat_hdrs_withIdx["Style No"]] != None, data_catType))
        data_catType_onlyStyleNo = list(filter(lambda x: p.match(str(x[cat_hdrs_withIdx["Style No"]])), data_catType))
        catTypeName = list(map(lambda x: x[cat_hdrs_withIdx["Style No"]], data_catType_onlyStyleNo))
#        #### WM row 별 header명 과 짝짓기
        data_withHdrsIdx = list(map(lambda y: list(map(lambda x: y[x], eff_hdrs_v)), data_catType_onlyStyleNo))
        dict_ = list(map(lambda x: dict(zip(eff_hdrs_k, x)), data_withHdrsIdx))
        dicts_final = list(map(lambda y: dict(filter(lambda x: x[1]!=None, y.items())),dict_))

        for oneDict in dicts_final:
            keys = oneDict.keys()
            for i in hdrs_k:
                if i not in keys:
                    oneDict[i] = ""

        return [eff_cat_hdrs, dict(zip(catTypeName,dicts_final))]
    
    return dict(zip(row_sep_criteria, map(setDict_OnEachCatType, datas_allCatType)))
    

dictsAIO = get_DataOnRangesAtSheet(sheet, row_sep_criteria)

def make_finalForm_forIntFinishStyle(dictsAIO):
    #infFinish_order = ["Floor", "Base", "Wall", "Ceiling"]
    
    final_output = []

    styleTypes = dictsAIO.values()
    for styleType in styleTypes:
        keys = styleType[0]
        dd = styleType[1:][0].values()
        tmp = []
        for i in dd:
            tmp = []
            for k in keys:
                tmp.append(i[k])
            final_output.append(tmp)


    return final_output

# Assign your output to the OUT variable.

OUT = make_finalForm_forIntFinishStyle(dictsAIO)

#hdrs_withIdx = find_headersAtSheet(sheet)
#hdrs_v = list(hdrs_withIdx.values())
#hdrs_k = list(hdrs_withIdx.keys())

#rangesATSheet = find_rangesAtSheet_eq(sheet, hdrs_withIdx, "Exterior Wall", row_sep_criteria)
#OUT = rangesATSheet
# ----------------------------------------
list_create_2 = List.Create(item0=parse_roof_style_no_시트_as_dict)
code_block_6 = CodeBlock()
# ---------- code_block_6.designscript (3 lines) ----------
["Single Door", "Double Door", "Transsom", "Shutter / Sliding / Hanger / Swing / Revolving / Folding"];
5;
 // 시작row 인덱스;
# ----------------------------------------
parse_door_style_no_시트_as_dict = Python(IN[0]=code_block_2.out3, IN[1]=code_block_6.out0, IN[2]=code_block_6.out1)  # CPython3
# ---------- parse_door_style_no_시트_as_dict.python (168 lines) ----------
# Load the Python Standard and DesignScript Libraries
import sys
import clr
clr.AddReference('ProtoGeometry')
from Autodesk.DesignScript.Geometry import *

from functools import reduce
from functools import partial
from itertools import chain

import re
# The inputs to this node will be stored as a list in the IN variables.
dataEnteringNode = IN
wholeDatas = IN[0]
dataStartRowIdx = IN[2]
sheet = wholeDatas[dataStartRowIdx:]
row_sep_criteria = IN[1]
#headers = IN[3]

# Place your code below this line

def find_IsInStr(target, str):
    if target == None or str == None:
        pass
    else:
        res = target in str
        return res

def find_IsIn_list(target, lst):
    if target == None or str == None:
        pass
    else:
        res = target in lst
        return res

def find_range_by_columnItem(db, col_idx, sep_rule):
    tdb = list(map(lambda x: x[col_idx], db))
    last_idx_tdb = len(tdb)-1
    tdb_enum = enumerate(tdb)
    res = list(filter(lambda x: find_IsInStr(sep_rule, x[1]), tdb_enum))
    endidxs_tmp= list(map(lambda x: x[0]-1,res))
    endidxs_tmp.pop(0)
    endidxs = endidxs_tmp + [last_idx_tdb]
    famTypeNames = list(map(lambda x: x[1],res))
    famTypeNamesIdxs = list(map(lambda x: x[0],res))
    rangeSttIdxs = list(map(lambda x: x[0]+1,res))
    rangeEndIdxs = endidxs
    result = dict(zip(famTypeNames, zip(famTypeNamesIdxs, zip(rangeSttIdxs,rangeEndIdxs))))
    return result

def find_range_by_columnItem_Eq(db, col_idx, row_sep_criteria):
    tdb = list(map(lambda x: x[col_idx], db))
    last_idx_tdb = len(tdb)-1
    tdb_enum = enumerate(tdb)
    res = list(filter(lambda x: find_IsIn_list(x[1], row_sep_criteria), tdb_enum))
    endidxs_tmp= list(map(lambda x: x[0]-1,res))
    endidxs_tmp.pop(0)
    endidxs = endidxs_tmp + [last_idx_tdb]
    famTypeNames = list(map(lambda x: x[1],res))
    famTypeNamesIdxs = list(map(lambda x: x[0],res))
    rangeSttIdxs = list(map(lambda x: x[0]+1,res))
    rangeEndIdxs = endidxs
    result = dict(zip(famTypeNames, zip(famTypeNamesIdxs, zip(rangeSttIdxs,rangeEndIdxs))))
    return result
    
def find_headersAtSheet(sheet):
    headers_sheet = map(lambda x: [x[1].replace("\n",""),x[0]], filter(lambda x: x[1] != None, enumerate(sheet[1])))
    
    return dict(headers_sheet)

def find_rangesAtSheet(sheet, hdrs_withIdx, trgt_hdr, trgt_str):
    return find_range_by_columnItem(sheet, hdrs_withIdx[trgt_hdr], trgt_str)

def find_rangesAtSheet_eq(sheet, hdrs_withIdx, trgt_hdr, row_sep_criteria):
    res = find_range_by_columnItem_Eq(sheet, hdrs_withIdx[trgt_hdr], row_sep_criteria)
    
    return res

headers = sorted(find_headersAtSheet(sheet),key=lambda x:find_headersAtSheet(sheet)[x])
del headers[0]

def get_DataOnRangesAtSheet(sheet, row_sep_criteria):
    hdrs_withIdx = find_headersAtSheet(sheet)
    rangesATSheet = find_rangesAtSheet_eq(sheet, hdrs_withIdx, "Single Door", row_sep_criteria)
    title_idx = map(lambda x: x[0], rangesATSheet.values())
    catType_colDatas = list(map(lambda x: x[hdrs_withIdx["Single Door"]], sheet))
    catTypes = list(map(lambda x: catType_colDatas[x], title_idx))
    rgs_v = list(map(lambda x: x[1], rangesATSheet.values()))
    rgs_k = list(map(lambda x: x, rangesATSheet.keys()))
    
    datas_allCatType_withSubHdrs = list(map(lambda x: sheet[x[0]-1:x[1]], rgs_v))
    def remove_elem_atIdx(lst, idx):
        del lst[idx]
        return lst 
    datas_allCatType = list(map(lambda x: remove_elem_atIdx(x,1), datas_allCatType_withSubHdrs))
    
    def setDict_OnEachCatType(data_catType):
        cat_hdrsRow = data_catType.pop(0)
        eff_cat_hdrs = list(filter(lambda x: x!=None, cat_hdrsRow[2:]))
        
        cat_hdrs_withIdx_all = dict(map(lambda x: [x[1].replace("\n",""),x[0]], filter(lambda x: x[1] != None, enumerate(cat_hdrsRow))))
        
        hdrs_v = list(cat_hdrs_withIdx_all.values())
        hdrs_k = list(cat_hdrs_withIdx_all.keys())
        eff_hdrs_v = hdrs_v[1:]
        eff_hdrs_k = hdrs_k[1:]
        cat_hdrs_withIdx_originName = dict(list(zip(eff_hdrs_k, eff_hdrs_v)))
        
        cat_hdrs_withIdx = { k.replace(' (Key Name)', ''): v for k, v in cat_hdrs_withIdx_originName.items() }
        
                    
        
        ## 문자 1~2자리 + 숫자 2자리
        p = re.compile('[A-Z]{1,3}\d{2}')
        
        
        data_catType_noneless = list(filter(lambda x: x[cat_hdrs_withIdx["Style No"]] != None, data_catType))
        data_catType_onlyStyleNo = list(filter(lambda x: p.match(str(x[cat_hdrs_withIdx["Style No"]])), data_catType))
        catTypeName = list(map(lambda x: x[cat_hdrs_withIdx["Style No"]], data_catType_onlyStyleNo))
#        #### WM row 별 header명 과 짝짓기
        data_withHdrsIdx = list(map(lambda y: list(map(lambda x: y[x], eff_hdrs_v)), data_catType_onlyStyleNo))
        dict_ = list(map(lambda x: dict(zip(eff_hdrs_k, x)), data_withHdrsIdx))
        dicts_final = list(map(lambda y: dict(filter(lambda x: x[1]!=None, y.items())),dict_))

        for oneDict in dicts_final:
            keys = oneDict.keys()
            for i in hdrs_k:
                if i not in keys:
                    oneDict[i] = ""
                elif i == "Fire Rating":
                    oneDict[i] = ""

        return [eff_cat_hdrs, dict(zip(catTypeName,dicts_final))]
    
    return dict(zip(row_sep_criteria, map(setDict_OnEachCatType, datas_allCatType)))
    

dictsAIO = get_DataOnRangesAtSheet(sheet, row_sep_criteria)

def make_finalForm_forIntFinishStyle(dictsAIO):
    #infFinish_order = ["Floor", "Base", "Wall", "Ceiling"]
    
    final_output = []

    styleTypes = dictsAIO.values()
    for styleType in styleTypes:
        keys = styleType[0]
        dd = styleType[1:][0].values()
        tmp = []
        for i in dd:
            tmp = []
            for k in keys:
                tmp.append(i[k])
            final_output.append(tmp)


    return final_output

# Assign your output to the OUT variable.

OUT = make_finalForm_forIntFinishStyle(dictsAIO)

#hdrs_withIdx = find_headersAtSheet(sheet)
#hdrs_v = list(hdrs_withIdx.values())
#hdrs_k = list(hdrs_withIdx.keys())

#rangesATSheet = find_rangesAtSheet_eq(sheet, hdrs_withIdx, "Exterior Wall", row_sep_criteria)
#OUT = rangesATSheet
# ----------------------------------------
list_create_3 = List.Create(item0=parse_door_style_no_시트_as_dict)
code_block_7 = CodeBlock()
# ---------- code_block_7.designscript (3 lines) ----------
["Sliding Type", "Awning Type", "Fix Type", "Combination Type", "Skylight", "MISC", "Louver"];
5;
 // 시작row 인덱스;
# ----------------------------------------
parse_window_style_no_시트_as_dict = Python(IN[0]=code_block_2.out4, IN[1]=code_block_7.out0, IN[2]=code_block_7.out1)  # CPython3
# ---------- parse_window_style_no_시트_as_dict.python (172 lines) ----------
# Load the Python Standard and DesignScript Libraries
import sys
import clr
clr.AddReference('ProtoGeometry')
from Autodesk.DesignScript.Geometry import *

from functools import reduce
from functools import partial
from itertools import chain

import re
# The inputs to this node will be stored as a list in the IN variables.
dataEnteringNode = IN
wholeDatas = IN[0]
dataStartRowIdx = IN[2]
sheet = wholeDatas[dataStartRowIdx:]
row_sep_criteria = IN[1]
#headers = IN[3]

# Place your code below this line

def find_IsInStr(target, str):
    if target == None or str == None:
        pass
    else:
        res = target in str
        return res

def find_IsIn_list(target, lst):
    if target == None or str == None:
        pass
    else:
        res = target in lst
        return res

def find_range_by_columnItem(db, col_idx, sep_rule):
    tdb = list(map(lambda x: x[col_idx], db))
    last_idx_tdb = len(tdb)-1
    tdb_enum = enumerate(tdb)
    res = list(filter(lambda x: find_IsInStr(sep_rule, x[1]), tdb_enum))
    endidxs_tmp= list(map(lambda x: x[0]-1,res))
    endidxs_tmp.pop(0)
    endidxs = endidxs_tmp + [last_idx_tdb]
    famTypeNames = list(map(lambda x: x[1],res))
    famTypeNamesIdxs = list(map(lambda x: x[0],res))
    rangeSttIdxs = list(map(lambda x: x[0]+1,res))
    rangeEndIdxs = endidxs
    result = dict(zip(famTypeNames, zip(famTypeNamesIdxs, zip(rangeSttIdxs,rangeEndIdxs))))
    return result

def find_range_by_columnItem_Eq(db, col_idx, row_sep_criteria):
    tdb = list(map(lambda x: x[col_idx], db))
    last_idx_tdb = len(tdb)-1
    tdb_enum = enumerate(tdb)
    res = list(filter(lambda x: find_IsIn_list(x[1], row_sep_criteria), tdb_enum))
    endidxs_tmp= list(map(lambda x: x[0]-1,res))
    endidxs_tmp.pop(0)
    endidxs = endidxs_tmp + [last_idx_tdb]
    famTypeNames = list(map(lambda x: x[1],res))
    famTypeNamesIdxs = list(map(lambda x: x[0],res))
    rangeSttIdxs = list(map(lambda x: x[0]+1,res))
    rangeEndIdxs = endidxs
    result = dict(zip(famTypeNames, zip(famTypeNamesIdxs, zip(rangeSttIdxs,rangeEndIdxs))))
    return result
    
def find_headersAtSheet(sheet):
    headers_sheet = map(lambda x: [x[1].replace("\n",""),x[0]], filter(lambda x: x[1] != None, enumerate(sheet[1])))
    
    return dict(headers_sheet)

def find_rangesAtSheet(sheet, hdrs_withIdx, trgt_hdr, trgt_str):
    return find_range_by_columnItem(sheet, hdrs_withIdx[trgt_hdr], trgt_str)

def find_rangesAtSheet_eq(sheet, hdrs_withIdx, trgt_hdr, row_sep_criteria):
    res = find_range_by_columnItem_Eq(sheet, hdrs_withIdx[trgt_hdr], row_sep_criteria)
    
    return res

headers = sorted(find_headersAtSheet(sheet),key=lambda x:find_headersAtSheet(sheet)[x])
del headers[0]

def get_DataOnRangesAtSheet(sheet, row_sep_criteria):
    hdrs_withIdx = find_headersAtSheet(sheet)
    rangesATSheet = find_rangesAtSheet_eq(sheet, hdrs_withIdx, "Sliding Type", row_sep_criteria)
    title_idx = map(lambda x: x[0], rangesATSheet.values())
    catType_colDatas = list(map(lambda x: x[hdrs_withIdx["Sliding Type"]], sheet))
    catTypes = list(map(lambda x: catType_colDatas[x], title_idx))
    rgs_v = list(map(lambda x: x[1], rangesATSheet.values()))
    rgs_k = list(map(lambda x: x, rangesATSheet.keys()))
    
    datas_allCatType_withSubHdrs = list(map(lambda x: sheet[x[0]-1:x[1]], rgs_v))
    def remove_elem_atIdx(lst, idx):
        del lst[idx]
        return lst 
    datas_allCatType = list(map(lambda x: remove_elem_atIdx(x,1), datas_allCatType_withSubHdrs))
    
    def setDict_OnEachCatType(data_catType):
        cat_hdrsRow = data_catType.pop(0)
        eff_cat_hdrs = list(filter(lambda x: x!=None, cat_hdrsRow[2:]))
        
        cat_hdrs_withIdx_all = dict(map(lambda x: [x[1].replace("\n",""),x[0]], filter(lambda x: x[1] != None, enumerate(cat_hdrsRow))))
        
        hdrs_v = list(cat_hdrs_withIdx_all.values())
        hdrs_k = list(cat_hdrs_withIdx_all.keys())
        eff_hdrs_v = hdrs_v[1:]
        eff_hdrs_k = hdrs_k[1:]
        cat_hdrs_withIdx_originName = dict(list(zip(eff_hdrs_k, eff_hdrs_v)))
        
        cat_hdrs_withIdx = { k.replace(' (Key Name)', ''): v for k, v in cat_hdrs_withIdx_originName.items() }
        
                    
        
        ## 문자 1~2자리 + 숫자 2자리
        p = re.compile('[A-Z]{1,3}\d{2}')
        
        
        data_catType_noneless = list(filter(lambda x: x[cat_hdrs_withIdx["Style No"]] != None, data_catType))
        data_catType_onlyStyleNo = list(filter(lambda x: p.match(str(x[cat_hdrs_withIdx["Style No"]])), data_catType))
        catTypeName = list(map(lambda x: x[cat_hdrs_withIdx["Style No"]], data_catType_onlyStyleNo))
#        #### WM row 별 header명 과 짝짓기
        data_withHdrsIdx = list(map(lambda y: list(map(lambda x: y[x], eff_hdrs_v)), data_catType_onlyStyleNo))
        dict_ = list(map(lambda x: dict(zip(eff_hdrs_k, x)), data_withHdrsIdx))
        dicts_final = list(map(lambda y: dict(filter(lambda x: x[1]!=None, y.items())),dict_))

        for oneDict in dicts_final:
            keys = oneDict.keys()
            for i in hdrs_k:
                if i not in keys:
                    oneDict[i] = ""
                elif i == "Fire Rating":
                    oneDict[i] = ""

        return [eff_cat_hdrs, dict(zip(catTypeName,dicts_final))]
    
    return dict(zip(row_sep_criteria, map(setDict_OnEachCatType, datas_allCatType)))
    

dictsAIO = get_DataOnRangesAtSheet(sheet, row_sep_criteria)

def make_finalForm_forIntFinishStyle(dictsAIO):
    #infFinish_order = ["Floor", "Base", "Wall", "Ceiling"]
    
    final_output = []

    styleTypes = dictsAIO.values()
    for styleType in styleTypes:
        keys = styleType[0]
        dd = styleType[1:][0].values()
        tmp = []
        for i in dd:
            tmp = []
            for k in keys:
                tmp.append(i[k])
            final_output.append(tmp)


    return final_output

# Assign your output to the OUT variable.

OUT = make_finalForm_forIntFinishStyle(dictsAIO)

#hdrs_withIdx = find_headersAtSheet(sheet)
#hdrs_v = list(hdrs_withIdx.values())
#hdrs_k = list(hdrs_withIdx.keys())

#rangesATSheet = find_rangesAtSheet_eq(sheet, hdrs_withIdx, "Sliding Type", row_sep_criteria)



#catType_colDatas = list(map(lambda x: x[hdrs_withIdx["Sliding Type"]], sheet))
#OUT = catType_colDatas
# ----------------------------------------
list_create_4 = List.Create(item0=parse_window_style_no_시트_as_dict)
join = List.Join(list0=parse_int_finish_style_no_시트_as, list1=list_create, list2=list_create_2, list3=list_create_3, list4=list_create_4)
getItemAtIndex_2 = List.GetItemAtIndex(list=join, index=finish_category_선택)
fields = ScheduleView.Fields(scheduleView=getItemAtIndex)

# group: Key Schedule
code_block_8 = CodeBlock(viewSchedule=getItemAtIndex) { _viewSchedule: var[]..[]; }
code_block_9 = CodeBlock(data=getItemAtIndex_2) { _data: var[]..[]; }
code_block_10 = CodeBlock(parameterNames=fields) { _parameterNames: var[]..[]; }
python_script = Python(IN[0]=code_block_8, IN[1]=code_block_9, IN[2]=code_block_10)  # CPython3
# ---------- python_script.python (69 lines) ----------
#Copyright(c) 2015, Konrad Sobon
# @arch_laboratory, http://archi-lab.net

import clr
clr.AddReference('ProtoGeometry')
from Autodesk.DesignScript.Geometry import *

# Import DocumentManager and TransactionManager
clr.AddReference("RevitServices")
import RevitServices
from RevitServices.Persistence import DocumentManager
from RevitServices.Transactions import TransactionManager

# Import RevitAPI
clr.AddReference("RevitAPI")
import Autodesk
from Autodesk.Revit.DB import *

doc = DocumentManager.Instance.CurrentDBDocument
uiapp = DocumentManager.Instance.CurrentUIApplication
app = uiapp.Application

from System.Collections.Generic import *

# Import ToDSType(bool) extension method
clr.AddReference("RevitNodes")
import Revit
clr.ImportExtensions(Revit.Elements)

#The inputs to this node will be stored as a list in the IN variable.
dataEnteringNode = IN

keySchedule = UnwrapElement(IN[0])
data = IN[1]
inputParams = IN[2]

# "Start" the transaction
TransactionManager.Instance.EnsureInTransaction(doc)

test = []
count = []
cellParams = [[] for i in range(len(data))]
if any(isinstance(item, list) for item in data):
	# process list of lists
	for i in data:
		count.append(len(i))
	colCount = max(count)
	colAvailable = len(keySchedule.Definition.GetSchedulableFields())
	if colCount > colAvailable:
		message = "Please add/remove parameters to/from schedule so that they match longest data set."
	else:
		tableData = keySchedule.GetTableData()
		sectionData = tableData.GetSectionData(SectionType.Body)
		if sectionData.NumberOfRows - 2 <= len(data):
			# schedule by default will have 2 rows (A, B, C and Header Names)
			rowsToAdd = (len(data) - sectionData.NumberOfRows) + 2
			for i in range(0, rowsToAdd, 1):
				sectionData.InsertRow(0)
		else:
			# schedule when updating might already have too many rows 
			rowsToDelete = sectionData.NumberOfRows - 2 - len(data)
			for i in reversed(range(sectionData.NumberOfRows - rowsToDelete, sectionData.NumberOfRows, 1)):
				sectionData.RemoveRow(i)

# "End" the transaction
TransactionManager.Instance.TransactionTaskDone()

#Assign your output to the OUT variable
OUT = keySchedule
# ----------------------------------------
code_block_11 = CodeBlock { _upperCase: bool = false; }
python_script_2 = Python(IN[0]=python_script, IN[1]=code_block_9, IN[2]=code_block_10, IN[3]=code_block_11)  # CPython3
# ---------- python_script_2.python (87 lines) ----------
#Copyright(c) 2015, Konrad Sobon
# @arch_laboratory, http://archi-lab.net

import clr
import sys
clr.AddReference('ProtoGeometry')
from Autodesk.DesignScript.Geometry import *

# Import DocumentManager and TransactionManager
clr.AddReference("RevitServices")
import RevitServices
from RevitServices.Persistence import DocumentManager
from RevitServices.Transactions import TransactionManager

# Import RevitAPI
clr.AddReference("RevitAPI")
import Autodesk
from Autodesk.Revit.DB import *

doc = DocumentManager.Instance.CurrentDBDocument
uiapp = DocumentManager.Instance.CurrentUIApplication
app = uiapp.Application

from System.Collections.Generic import *

# Import ToDSType(bool) extension method
clr.AddReference("RevitNodes")
import Revit
clr.ImportExtensions(Revit.Elements)

pyt_path = r'C:\Program Files (x86)\IronPython 2.7\Lib'
sys.path.append(pyt_path)
import re

#The inputs to this node will be stored as a list in the IN variable.
dataEnteringNode = IN

keySchedule = UnwrapElement(IN[0])
data = IN[1]
inputParams = IN[2]
upper = IN[3]

# "Start" the transaction
TransactionManager.Instance.EnsureInTransaction(doc)

tableData = keySchedule.GetTableData()
sectionData = tableData.GetSectionData(SectionType.Body)

keyNames = []
for i in range(1,sectionData.NumberOfRows - 1,1):
	keyNames.append(str(int(i)))

allKeys = FilteredElementCollector(doc).WhereElementIsNotElementType()
params = [[] for i in range(len(keyNames))]
test = []
for key in allKeys:
	try:
		if key.get_Parameter(BuiltInParameter.REF_TABLE_ELEM_NAME).AsString() in keyNames and key.OwnerViewId == keySchedule.Id:
			indexValue = keyNames.index(key.get_Parameter(BuiltInParameter.REF_TABLE_ELEM_NAME).AsString())
			for i in range(0, len(inputParams),1):
				params[indexValue].extend(key.GetParameters(str(inputParams[i])))
	except:
		pass

for i, j in zip(params, data):
	for param, value in zip(i,j):
		if isinstance(value, str):
			#valueDecoded = value.decode('string_escape')
			valueDecoded = value.encode('utf-8').decode('unicode-escape')
		else:
			if value == None:
				valueDecoded = " "
			else:
				#valueDecoded = str(value).decode('string_escape')
				valueDecoded = str(value).encode('utf-8').decode('unicode-escape')
		if upper:
			valueDecoded = valueDecoded.upper()
			param.Set(valueDecoded)
		else:
			param.Set(valueDecoded)


# "End" the transaction
TransactionManager.Instance.TransactionTaskDone()

#Assign your output to the OUT variable
OUT = keySchedule
# ----------------------------------------
code_block_12 = CodeBlock(viewSchedule=python_script_2) { _viewSchedule; }

valueAtKey = DesignScript.Builtin.Dictionary.ValueAtKey()  # frozen; unwired: dictionary, key

# group: 선택된 카테고리의 피니시스타일 데이터 정리
code_block_13 = CodeBlock(i=getItemAtIndex_2) { i; j; }  # unwired: j
keys = DesignScript.Builtin.Dictionary.Keys(dictionary=code_block_13.i)  # frozen
sort = List.Sort(list=keys)
valueAtKey_2 = DesignScript.Builtin.Dictionary.ValueAtKey(dictionary=code_block_13.i, key=sort)
valueAtKey_3 = DesignScript.Builtin.Dictionary.ValueAtKey(dictionary=valueAtKey_2@@L1, key=code_block_13.j)

code_block_14 = CodeBlock(iii=code_block_2.out2) { iii; }
code_block_15 = CodeBlock { ["Floor", "Base", "Wall", "Ceiling"]; }
