# Dynamo graph Load Distributer.dyn (Dynamo 2.16.1.2727)

rooms_by_status = RoomsByStatus()
code_block = CodeBlock(i=rooms_by_status.PlacedRooms) { i; }
coreCenterBoundary = Room.CoreCenterBoundary(room=code_block)
categories = Categories("OST_StructuralColumns")
all_elements_of_category = ElementsOfCategory(Category=categories)
separate_ug = Python(IN[0]=all_elements_of_category)  # CPython3
# ---------- separate_ug.python (43 lines) ----------
# Load the Python Standard and DesignScript Libraries
import sys
import clr
clr.AddReference('ProtoGeometry')
from Autodesk.DesignScript.Geometry import *

#################################Module For Functional Programing#############################################
from functools import reduce
curry = lambda f: lambda a,*args: f(a, *args) if (len(args)) else lambda *args: f(a, *args)

filter = curry(filter)
map = curry(map)

def _take(length, iter):
    res = []
    for a in iter:
        res.append(a)
        if len(res) == length:
            return res
        
take = curry(_take)
reduce = curry(reduce)

go = lambda *args: reduce(lambda a,f: f(a), args) ## 함수도 축약 가능 ##
##############################################################################################################
# The inputs to this node will be stored as a list in the IN variables.
dataEnteringNode = IN
elems = IN[0]
# Place your code below this line

find_ugs = lambda col: go\
(col,
    filter(lambda x: "UG" in str(x.GetParameterValueByName("Type"))),

)
find_ags = lambda col: go\
(col,
    filter(lambda x: "UG" not in str(x.GetParameterValueByName("Type"))),

)

# Assign your output to the OUT variable.
OUT = find_ugs(elems), find_ags(elems)
# ----------------------------------------
UG = CodeBlock(i=separate_ug) { i[0]; }
getActualLocation = AnalyticalAutomation.RevitElements.Element.GetActualLocation(element=UG)
categories_2 = Categories("OST_StructuralFraming")
all_elements_of_category_2 = ElementsOfCategory(Category=categories_2)
separate_ug_2 = Python(IN[0]=all_elements_of_category_2)  # CPython3
# ---------- separate_ug_2.python (43 lines) ----------
# Load the Python Standard and DesignScript Libraries
import sys
import clr
clr.AddReference('ProtoGeometry')
from Autodesk.DesignScript.Geometry import *

#################################Module For Functional Programing#############################################
from functools import reduce
curry = lambda f: lambda a,*args: f(a, *args) if (len(args)) else lambda *args: f(a, *args)

filter = curry(filter)
map = curry(map)

def _take(length, iter):
    res = []
    for a in iter:
        res.append(a)
        if len(res) == length:
            return res
        
take = curry(_take)
reduce = curry(reduce)

go = lambda *args: reduce(lambda a,f: f(a), args) ## 함수도 축약 가능 ##
##############################################################################################################
# The inputs to this node will be stored as a list in the IN variables.
dataEnteringNode = IN
elems = IN[0]
# Place your code below this line

find_ugs = lambda col: go\
(col,
    filter(lambda x: "TG" in str(x.GetParameterValueByName("Type"))),

)
find_ags = lambda col: go\
(col,
    filter(lambda x: "TG" not in str(x.GetParameterValueByName("Type"))),

)

# Assign your output to the OUT variable.
OUT = find_ugs(elems), find_ags(elems)
# ----------------------------------------
UG_2 = CodeBlock(i=separate_ug_2) { i[0]; }
getActualLocation_2 = AnalyticalAutomation.RevitElements.Element.GetActualLocation(element=UG_2)
AG = CodeBlock(i=separate_ug) { i[1]; }
AG_2 = CodeBlock(i=separate_ug_2) { i[1]; }
trim = Geometry.Trim()  # unwired: geometry, other, pick
levels = Levels("TOF")
parameters = Element.Parameters(element=code_block)
code_block_2 = CodeBlock { "Level"; }
getParameterValueByName = Element.GetParameterValueByName(element=code_block, parameterName=code_block_2)
categories_3 = Categories("OST_Floors")
all_elements_of_category_3 = ElementsOfCategory(Category=categories_3)
getActualLocation_3 = AnalyticalAutomation.RevitElements.Element.GetActualLocation(element=all_elements_of_category_3)
parameters_2 = Element.Parameters(element=all_elements_of_category_3)
separate_ug_3 = Python(IN[0]=all_elements_of_category_3)  # CPython3
# ---------- separate_ug_3.python (46 lines) ----------
# Load the Python Standard and DesignScript Libraries
import sys
import clr
clr.AddReference('ProtoGeometry')
from Autodesk.DesignScript.Geometry import *

#################################Module For Functional Programing#############################################
from functools import reduce
curry = lambda f: lambda a,*args: f(a, *args) if (len(args)) else lambda *args: f(a, *args)

filter = curry(filter)
map = curry(map)

def _take(length, iter):
    res = []
    for a in iter:
        res.append(a)
        if len(res) == length:
            return res
        
take = curry(_take)
reduce = curry(reduce)

go = lambda *args: reduce(lambda a,f: f(a), args) ## 함수도 축약 가능 ##
##############################################################################################################
# The inputs to this node will be stored as a list in the IN variables.
dataEnteringNode = IN
elems = IN[0]
# Place your code below this line

find_ugs = lambda col: go\
(col,
    filter(lambda x: "TG" in str(x.GetParameterValueByName("Type"))),

)

find_ags = lambda col: go\
(col,
    #map(lambda x: x.GetParameterValueByName("Level")),
    #map(lambda x: dir(x)),
    #map(lambda x: x.get_Curves()),

)

# Assign your output to the OUT variable.
OUT = find_ugs(elems), find_ags(elems)
# ----------------------------------------
UG_3 = CodeBlock(i=separate_ug_3) { i[0]; }
AG_3 = CodeBlock(i=separate_ug_3) { i[1]; }
python_script = Python(IN[0]=separate_ug_3)  # CPython3; unwired: IN[1]; starter script, not edited (OUT = 0)
