# Dynamo graph Wall_Mark_lower.dyn (Dynamo 2.16.1.2727)

categories = Categories("OST_Walls")
all_elements_of_category = ElementsOfCategory(Category=categories)
code_block = CodeBlock { "Wall Loca"; }
getParameterValueByName = Element.GetParameterValueByName(element=all_elements_of_category, parameterName=code_block)
code_block_2 = CodeBlock(i=getParameterValueByName) { i=="INT"; }
filterByBoolMask = List.FilterByBoolMask(list=all_elements_of_category, mask=code_block_2)
code_block_3 = CodeBlock(i=all_elements_of_category) { i; }
code_block_4 = CodeBlock { "Mark"; }
getParameterValueByName_2 = Element.GetParameterValueByName(element=code_block_3, parameterName=code_block_4)
toLower = String.ToLower(string=getParameterValueByName_2)
toUpper = String.ToUpper(string=getParameterValueByName_2)
setParameterByName = Element.SetParameterByName(element=code_block_3, parameterName=code_block_4, value=toUpper)  # frozen
