# Dynamo graph Finish Style_injector_1.0.0.dyn (Dynamo 2.16.1.2727)
# author: MK Jang
# Inject Finish Style Data in Building List into Revit Key Schedule

# group: Filtering Finish Style Schedule
categories = Categories("OST_Schedules")
all_elements_of_category = ElementsOfCategory(Category=categories)
name = Element.Name(element=all_elements_of_category)
isfinishstyleschedule = Python(IN[0]=name)  # CPython3
# ---------- isfinishstyleschedule.python (45 lines) ----------
# Load the Python Standard and DesignScript Libraries
import sys
import clr
clr.AddReference('ProtoGeometry')
from Autodesk.DesignScript.Geometry import *

# The inputs to this node will be stored as a list in the IN variables.
dataEnteringNode = IN
sch_names_list = IN[0]
# Place your code below this line
tgtList = [
    "Floor Finish Style",
    "Base Finish Style",
    "Wall Finish Style",
    "Ceiling Finish Style",
    "Wall Style",
    "Roof Style",
    "Door Style",
    "Window Style",
    ]
tgtStr = "Style"

def isInStr_tgt(inStr,tgtStr):
    if tgtStr in inStr:
        res = True
    else:
        res = False
    return res

def isInStr_tgtList(inStr,tgtList):
    tmp = []
    for tgt in tgtList:
        if tgt in inStr:
            tmp.append(True)
        else:
            tmp.append(False)
    return any(tmp)
        

res = list(map(lambda x: isInStr_tgt(x, tgtStr) , sch_names_list))
    


# Assign your output to the OUT variable.
OUT = res
# ----------------------------------------
filterByBoolMask = List.FilterByBoolMask(list=all_elements_of_category, mask=isfinishstyleschedule)

name_2 = Element.Name(element=filterByBoolMask.in)
sortByKey = List.SortByKey(list=filterByBoolMask.in, keys=name_2)
finish_category_선택 = CustomSelection("D_Ceiling Finish", items={A_Floor Finish: "0", B_Base Finish: "1", C_Wall Finish: "2", D_Ceiling Finish: "3", E_Wall Style: "4", F_Roof Style: "5", G_Door Style: "6", H_Window Style: "7"})  # graph input
getItemAtIndex = List.GetItemAtIndex(list=sortByKey.sortedList, index=finish_category_선택)

# group: Import From Excel
빌딩리스트_경로 = Filename(".\플랜트건축팀_BIM_팀 표준_Building List_Rev.B_박기범_2023.12.08.xlsx")  # graph input
file_from_path = FileObject(path=빌딩리스트_경로)
code_block = CodeBlock()
# ---------- code_block.designscript (7 lines) ----------
[
"Int Finish Style No"
,"Wall Style No"
,"Roof Style No"
,"Door Style No"
,"Window Style No"
];
# ----------------------------------------
boolean = BoolSelector(true)
importExcel = Data.ImportExcel(file=file_from_path, sheetName=code_block, showExcel=boolean)

code_block_2 = CodeBlock(i=importExcel) { i[0]; i[1]; i[2]; i[3]; i[4]; }
code_block_3 = CodeBlock()
# ---------- code_block_3.designscript (14 lines) ----------
["Floor", "Base", "Wall", "Ceiling", "Exterior Wall", "Roof"];
5;
 // 시작row 인덱스;
[
"Style No (Key Name)"
,"Floor Finish Style Name"
,"Floor Finish Ref."
,"Floor-Base Material"
,"Floor Finish-1"
,"Floor Finish-2"
,"Floor Finish-3"
,"Floor Finish-4"
,"Remark"
];
# ----------------------------------------
parse_int_finish_style_no_시트_as = Python(IN[0]=code_block_2.out0, IN[1]=code_block_3.out0, IN[2]=code_block_3.out1, IN[3]=code_block_3.out2)  # "Parse_Int Finish Style No 시트(as dict)"; CPython3
# ---------- parse_int_finish_style_no_시트_as.python (132 lines) ----------
# Load the Python Standard and DesignScript Libraries
import sys
import clr
clr.AddReference('ProtoGeometry')
from Autodesk.DesignScript.Geometry import *

from functools import reduce
from functools import partial

import re
# The inputs to this node will be stored as a list in the IN variables.
dataEnteringNode = IN
wholeDatas = IN[0]
dataStartRowIdx = IN[2]
sheet = wholeDatas[dataStartRowIdx:]
row_sep_criteria = IN[1]
headers = IN[3]

# Place your code below this line

def find_IsInStr(target, str):
    if target == None or str == None:
        pass
    else:
        res = target in str
        return res

def find_IsIn_list(target, lst):
    if target == None or str == None:
        pass
    else:
        res = target in lst
        return res

def find_range_by_columnItem(db, col_idx, sep_rule):
    tdb = list(map(lambda x: x[col_idx], db))
    last_idx_tdb = len(tdb)-1
    tdb_enum = enumerate(tdb)
    res = list(filter(lambda x: find_IsInStr(sep_rule, x[1]), tdb_enum))
    endidxs_tmp= list(map(lambda x: x[0]-1,res))
    endidxs_tmp.pop(0)
    endidxs = endidxs_tmp + [last_idx_tdb]
    famTypeNames = list(map(lambda x: x[1],res))
    famTypeNamesIdxs = list(map(lambda x: x[0],res))
    rangeSttIdxs = list(map(lambda x: x[0]+1,res))
    rangeEndIdxs = endidxs
    result = dict(zip(famTypeNames, zip(famTypeNamesIdxs, zip(rangeSttIdxs,rangeEndIdxs))))
    return result

def find_range_by_columnItem_Eq(db, col_idx, row_sep_criteria):
    tdb = list(map(lambda x: x[col_idx], db))
    last_idx_tdb = len(tdb)-1
    tdb_enum = enumerate(tdb)
    res = list(filter(lambda x: find_IsIn_list(x[1], row_sep_criteria), tdb_enum))
    endidxs_tmp= list(map(lambda x: x[0]-1,res))
    endidxs_tmp.pop(0)
    endidxs = endidxs_tmp + [last_idx_tdb]
    famTypeNames = list(map(lambda x: x[1],res))
    famTypeNamesIdxs = list(map(lambda x: x[0],res))
    rangeSttIdxs = list(map(lambda x: x[0]+1,res))
    rangeEndIdxs = endidxs
    result = dict(zip(famTypeNames, zip(famTypeNamesIdxs, zip(rangeSttIdxs,rangeEndIdxs))))
    return result
    
def find_headersAtSheet(sheet):
    headers_sheet = map(lambda x: [x[1].replace("\n",""),x[0]], filter(lambda x: x[1] != None, enumerate(sheet[1])))
    
    return dict(headers_sheet)

def find_rangesAtSheet(sheet, hdrs_withIdx, trgt_hdr, trgt_str):
    return find_range_by_columnItem(sheet, hdrs_withIdx[trgt_hdr], trgt_str)

def find_rangesAtSheet_eq(sheet, hdrs_withIdx, trgt_hdr, row_sep_criteria):
    res = find_range_by_columnItem_Eq(sheet, hdrs_withIdx[trgt_hdr], row_sep_criteria)
    
    return res

def get_DataOnRangesAtSheet(sheet, row_sep_criteria):
    hdrs_withIdx = find_headersAtSheet(sheet)
    rangesATSheet = find_rangesAtSheet_eq(sheet, hdrs_withIdx, "Floor", row_sep_criteria)
    title_idx = map(lambda x: x[0], rangesATSheet.values())
    catType_colDatas = list(map(lambda x: x[hdrs_withIdx["Floor"]], sheet))
    catTypes = list(map(lambda x: catType_colDatas[x], title_idx))
    rgs_v = list(map(lambda x: x[1], rangesATSheet.values()))
    rgs_k = list(map(lambda x: x, rangesATSheet.keys()))
    
    
    datas_allCatType = list(map(lambda x: sheet[x[0]-1:x[1]], rgs_v))
    
    def setDict_OnEachCatType(data_catType):
        cat_hdrsRow = data_catType.pop(0)
        
        cat_hdrs_withIdx = dict(map(lambda x: [x[1].replace("\n",""),x[0]], filter(lambda x: x[1] != None, enumerate(cat_hdrsRow))))
        
        hdrs_v = list(cat_hdrs_withIdx.values())
        hdrs_k = list(cat_hdrs_withIdx.keys())
        eff_hdrs_v = hdrs_v[1:]
        eff_hdrs_k = hdrs_k[1:]
    
        ## 문자 1~2자리 + 숫자 2자리
        p = re.compile('[A-Z]{1,3}\d{2}')
        
        
        data_catType_noneless = list(filter(lambda x: x[cat_hdrs_withIdx["Style No (Key Name)"]] != None, data_catType))
        data_catType_onlyStyleNo = list(filter(lambda x: p.match(str(x[cat_hdrs_withIdx["Style No (Key Name)"]])), data_catType))
        catTypeName = list(map(lambda x: x[cat_hdrs_withIdx["Style No (Key Name)"]], data_catType_onlyStyleNo))
        ### WM row 별 header명 과 짝짓기
        data_withHdrsIdx = list(map(lambda y: list(map(lambda x: y[x], eff_hdrs_v)), data_catType_onlyStyleNo))
        dict_ = list(map(lambda x: dict(zip(eff_hdrs_k, x)), data_withHdrsIdx))
        dicts_final = list(map(lambda y: dict(filter(lambda x: x[1]!=None, y.items())),dict_))
        
        for oneDict in dicts_final:
            keys = oneDict.keys()
            for i in hdrs_k:
                if i not in keys:
                    oneDict[i] = ""

        return dict(zip(catTypeName,dicts_final))
    
    return dict(zip(row_sep_criteria, map(setDict_OnEachCatType, datas_allCatType)))
    

dictsAIO = get_DataOnRangesAtSheet(sheet, row_sep_criteria)

# Assign your output to the OUT variable.

OUT = dictsAIO

#hdrs_withIdx = find_headersAtSheet(sheet)
#hdrs_v = list(hdrs_withIdx.values())
#hdrs_k = list(hdrs_withIdx.keys())
#OUT = hdrs_k
# ----------------------------------------
valueAtKey = DesignScript.Builtin.Dictionary.ValueAtKey(dictionary=parse_int_finish_style_no_시트_as, key=code_block_3.out0)
code_block_4 = CodeBlock { [4,5]; }
removeItemAtIndex = List.RemoveItemAtIndex(list=valueAtKey, indices=code_block_4)
code_block_5 = CodeBlock()
# ---------- code_block_5.designscript (14 lines) ----------
["Exterior Wall", "Interior Wall"];
5;
 // 시작row 인덱스;
[
"Style No (Key Name)"
,"Wall Style Name"
,"Wall Ref."
,"Wall Finish-In"
,"Wall Base Material-1"
,"Wall Base Material-2"
,"Wall Base Material-3"
,"Wall Finish-Ex"
,"Remark"
];
# ----------------------------------------
parse_wall_style_no_시트_as_dict = Python(IN[0]=code_block_2.out1, IN[1]=code_block_5.out0, IN[2]=code_block_5.out1, IN[3]=code_block_5.out2)  # CPython3
# ---------- parse_wall_style_no_시트_as_dict.python (142 lines) ----------
# Load the Python Standard and DesignScript Libraries
import sys
import clr
clr.AddReference('ProtoGeometry')
from Autodesk.DesignScript.Geometry import *

from functools import reduce
from functools import partial

import re
# The inputs to this node will be stored as a list in the IN variables.
dataEnteringNode = IN
wholeDatas = IN[0]
dataStartRowIdx = IN[2]
sheet = wholeDatas[dataStartRowIdx:]
row_sep_criteria = IN[1]
headers = IN[3]

# Place your code below this line

def find_IsInStr(target, str):
    if target == None or str == None:
        pass
    else:
        res = target in str
        return res

def find_IsIn_list(target, lst):
    if target == None or str == None:
        pass
    else:
        res = target in lst
        return res

def find_range_by_columnItem(db, col_idx, sep_rule):
    tdb = list(map(lambda x: x[col_idx], db))
    last_idx_tdb = len(tdb)-1
    tdb_enum = enumerate(tdb)
    res = list(filter(lambda x: find_IsInStr(sep_rule, x[1]), tdb_enum))
    endidxs_tmp= list(map(lambda x: x[0]-1,res))
    endidxs_tmp.pop(0)
    endidxs = endidxs_tmp + [last_idx_tdb]
    famTypeNames = list(map(lambda x: x[1],res))
    famTypeNamesIdxs = list(map(lambda x: x[0],res))
    rangeSttIdxs = list(map(lambda x: x[0]+1,res))
    rangeEndIdxs = endidxs
    result = dict(zip(famTypeNames, zip(famTypeNamesIdxs, zip(rangeSttIdxs,rangeEndIdxs))))
    return result

def find_range_by_columnItem_Eq(db, col_idx, row_sep_criteria):
    tdb = list(map(lambda x: x[col_idx], db))
    last_idx_tdb = len(tdb)-1
    tdb_enum = enumerate(tdb)
    res = list(filter(lambda x: find_IsIn_list(x[1], row_sep_criteria), tdb_enum))
    endidxs_tmp= list(map(lambda x: x[0]-1,res))
    endidxs_tmp.pop(0)
    endidxs = endidxs_tmp + [last_idx_tdb]
    famTypeNames = list(map(lambda x: x[1],res))
    famTypeNamesIdxs = list(map(lambda x: x[0],res))
    rangeSttIdxs = list(map(lambda x: x[0]+1,res))
    rangeEndIdxs = endidxs
    result = dict(zip(famTypeNames, zip(famTypeNamesIdxs, zip(rangeSttIdxs,rangeEndIdxs))))
    return result
    
def find_headersAtSheet(sheet):
    headers_sheet = map(lambda x: [x[1].replace("\n",""),x[0]], filter(lambda x: x[1] != None, enumerate(sheet[1])))
    
    return dict(headers_sheet)

def find_rangesAtSheet(sheet, hdrs_withIdx, trgt_hdr, trgt_str):
    return find_range_by_columnItem(sheet, hdrs_withIdx[trgt_hdr], trgt_str)

def find_rangesAtSheet_eq(sheet, hdrs_withIdx, trgt_hdr, row_sep_criteria):
    res = find_range_by_columnItem_Eq(sheet, hdrs_withIdx[trgt_hdr], row_sep_criteria)
    
    return res

def get_DataOnRangesAtSheet(sheet, row_sep_criteria):
    hdrs_withIdx = find_headersAtSheet(sheet)
    rangesATSheet = find_rangesAtSheet_eq(sheet, hdrs_withIdx, "Exterior Wall", row_sep_criteria)
    title_idx = map(lambda x: x[0], rangesATSheet.values())
    catType_colDatas = list(map(lambda x: x[hdrs_withIdx["Exterior Wall"]], sheet))
    catTypes = list(map(lambda x: catType_colDatas[x], title_idx))
    rgs_v = list(map(lambda x: x[1], rangesATSheet.values()))
    rgs_k = list(map(lambda x: x, rangesATSheet.keys()))
    
    datas_allCatType_withSubHdrs = list(map(lambda x: sheet[x[0]-1:x[1]], rgs_v))
    def remove_elem_atIdx(lst, idx):
        del lst[idx]
        return lst 
    datas_allCatType = list(map(lambda x: remove_elem_atIdx(x,1), datas_allCatType_withSubHdrs))
    
    def setDict_OnEachCatType(data_catType):
        cat_hdrsRow = data_catType.pop(0)
        
        cat_hdrs_withIdx_all = dict(map(lambda x: [x[1].replace("\n",""),x[0]], filter(lambda x: x[1] != None, enumerate(cat_hdrsRow))))
        
        hdrs_v = list(cat_hdrs_withIdx_all.values())
        hdrs_k = list(cat_hdrs_withIdx_all.keys())
        eff_hdrs_v = hdrs_v[1:]
        eff_hdrs_k = hdrs_k[1:]
        cat_hdrs_withIdx_originName = dict(list(zip(eff_hdrs_k, eff_hdrs_v)))
        
        cat_hdrs_withIdx = { k.replace(' (Key Name)', ''): v for k, v in cat_hdrs_withIdx_originName.items() }
        
                    
        
        ## 문자 1~2자리 + 숫자 2자리
        p = re.compile('[A-Z]{1,3}\d{2}')
        
        
        data_catType_noneless = list(filter(lambda x: x[cat_hdrs_withIdx["Style No"]] != None, data_catType))
        data_catType_onlyStyleNo = list(filter(lambda x: p.match(str(x[cat_hdrs_withIdx["Style No"]])), data_catType))
        catTypeName = list(map(lambda x: x[cat_hdrs_withIdx["Style No"]], data_catType_onlyStyleNo))
        #### WM row 별 header명 과 짝짓기
        data_withHdrsIdx = list(map(lambda y: list(map(lambda x: y[x], eff_hdrs_v)), data_catType_onlyStyleNo))
        dict_ = list(map(lambda x: dict(zip(eff_hdrs_k, x)), data_withHdrsIdx))
        dicts_final = list(map(lambda y: dict(filter(lambda x: x[1]!=None, y.items())),dict_))

        for oneDict in dicts_final:
            keys = oneDict.keys()
            for i in hdrs_k:
                if i not in keys:
                    oneDict[i] = ""

        return dict(zip(catTypeName,dicts_final))
    
    return dict(zip(row_sep_criteria, map(setDict_OnEachCatType, datas_allCatType)))
    

dictsAIO = get_DataOnRangesAtSheet(sheet, row_sep_criteria)

# Assign your output to the OUT variable.

OUT = dictsAIO

#hdrs_withIdx = find_headersAtSheet(sheet)
#hdrs_v = list(hdrs_withIdx.values())
#hdrs_k = list(hdrs_withIdx.keys())

#rangesATSheet = find_rangesAtSheet_eq(sheet, hdrs_withIdx, "Exterior Wall", row_sep_criteria)
#OUT = rangesATSheet
# ----------------------------------------
values = DesignScript.Builtin.Dictionary.Values(dictionary=parse_wall_style_no_시트_as_dict)
flatten = List.Flatten(list=values)
list_create = List.Create(item0=flatten)
code_block_6 = CodeBlock()
# ---------- code_block_6.designscript (15 lines) ----------
["Concrete Roof", "Cladding Roof"];
5;
 // 시작row 인덱스;
[
"Style No (Key Name)"
,"Roof Style Name"
,"Roof Ref."
,"Base Material Roof"
,"Roof Finish 1"
,"Roof Finish 2"
,"Roof Finish 3"
,"Roof Finish 4"
,"Roof Finish 5"
,"Remark"
];
# ----------------------------------------
parse_roof_style_no_시트_as_dict = Python(IN[0]=code_block_2.out2, IN[1]=code_block_6.out0, IN[2]=code_block_6.out1, IN[3]=code_block_6.out2)  # CPython3
# ---------- parse_roof_style_no_시트_as_dict.python (142 lines) ----------
# Load the Python Standard and DesignScript Libraries
import sys
import clr
clr.AddReference('ProtoGeometry')
from Autodesk.DesignScript.Geometry import *

from functools import reduce
from functools import partial

import re
# The inputs to this node will be stored as a list in the IN variables.
dataEnteringNode = IN
wholeDatas = IN[0]
dataStartRowIdx = IN[2]
sheet = wholeDatas[dataStartRowIdx:]
row_sep_criteria = IN[1]
headers = IN[3]

# Place your code below this line

def find_IsInStr(target, str):
    if target == None or str == None:
        pass
    else:
        res = target in str
        return res

def find_IsIn_list(target, lst):
    if target == None or str == None:
        pass
    else:
        res = target in lst
        return res

def find_range_by_columnItem(db, col_idx, sep_rule):
    tdb = list(map(lambda x: x[col_idx], db))
    last_idx_tdb = len(tdb)-1
    tdb_enum = enumerate(tdb)
    res = list(filter(lambda x: find_IsInStr(sep_rule, x[1]), tdb_enum))
    endidxs_tmp= list(map(lambda x: x[0]-1,res))
    endidxs_tmp.pop(0)
    endidxs = endidxs_tmp + [last_idx_tdb]
    famTypeNames = list(map(lambda x: x[1],res))
    famTypeNamesIdxs = list(map(lambda x: x[0],res))
    rangeSttIdxs = list(map(lambda x: x[0]+1,res))
    rangeEndIdxs = endidxs
    result = dict(zip(famTypeNames, zip(famTypeNamesIdxs, zip(rangeSttIdxs,rangeEndIdxs))))
    return result

def find_range_by_columnItem_Eq(db, col_idx, row_sep_criteria):
    tdb = list(map(lambda x: x[col_idx], db))
    last_idx_tdb = len(tdb)-1
    tdb_enum = enumerate(tdb)
    res = list(filter(lambda x: find_IsIn_list(x[1], row_sep_criteria), tdb_enum))
    endidxs_tmp= list(map(lambda x: x[0]-1,res))
    endidxs_tmp.pop(0)
    endidxs = endidxs_tmp + [last_idx_tdb]
    famTypeNames = list(map(lambda x: x[1],res))
    famTypeNamesIdxs = list(map(lambda x: x[0],res))
    rangeSttIdxs = list(map(lambda x: x[0]+1,res))
    rangeEndIdxs = endidxs
    result = dict(zip(famTypeNames, zip(famTypeNamesIdxs, zip(rangeSttIdxs,rangeEndIdxs))))
    return result
    
def find_headersAtSheet(sheet):
    headers_sheet = map(lambda x: [x[1].replace("\n",""),x[0]], filter(lambda x: x[1] != None, enumerate(sheet[1])))
    
    return dict(headers_sheet)

def find_rangesAtSheet(sheet, hdrs_withIdx, trgt_hdr, trgt_str):
    return find_range_by_columnItem(sheet, hdrs_withIdx[trgt_hdr], trgt_str)

def find_rangesAtSheet_eq(sheet, hdrs_withIdx, trgt_hdr, row_sep_criteria):
    res = find_range_by_columnItem_Eq(sheet, hdrs_withIdx[trgt_hdr], row_sep_criteria)
    
    return res

def get_DataOnRangesAtSheet(sheet, row_sep_criteria):
    hdrs_withIdx = find_headersAtSheet(sheet)
    rangesATSheet = find_rangesAtSheet_eq(sheet, hdrs_withIdx, "Concrete Roof", row_sep_criteria)
    title_idx = map(lambda x: x[0], rangesATSheet.values())
    catType_colDatas = list(map(lambda x: x[hdrs_withIdx["Concrete Roof"]], sheet))
    catTypes = list(map(lambda x: catType_colDatas[x], title_idx))
    rgs_v = list(map(lambda x: x[1], rangesATSheet.values()))
    rgs_k = list(map(lambda x: x, rangesATSheet.keys()))
    
    datas_allCatType_withSubHdrs = list(map(lambda x: sheet[x[0]-1:x[1]], rgs_v))
    def remove_elem_atIdx(lst, idx):
        del lst[idx]
        return lst 
    datas_allCatType = list(map(lambda x: remove_elem_atIdx(x,1), datas_allCatType_withSubHdrs))
    
    def setDict_OnEachCatType(data_catType):
        cat_hdrsRow = data_catType.pop(0)
        
        cat_hdrs_withIdx_all = dict(map(lambda x: [x[1].replace("\n",""),x[0]], filter(lambda x: x[1] != None, enumerate(cat_hdrsRow))))
        
        hdrs_v = list(cat_hdrs_withIdx_all.values())
        hdrs_k = list(cat_hdrs_withIdx_all.keys())
        eff_hdrs_v = hdrs_v[1:]
        eff_hdrs_k = hdrs_k[1:]
        cat_hdrs_withIdx_originName = dict(list(zip(eff_hdrs_k, eff_hdrs_v)))
        
        cat_hdrs_withIdx = { k.replace(' (Key Name)', ''): v for k, v in cat_hdrs_withIdx_originName.items() }
        
                    
        
        ## 문자 1~2자리 + 숫자 2자리
        p = re.compile('[A-Z]{1,3}\d{2}')
        
        
        data_catType_noneless = list(filter(lambda x: x[cat_hdrs_withIdx["Style No"]] != None, data_catType))
        data_catType_onlyStyleNo = list(filter(lambda x: p.match(str(x[cat_hdrs_withIdx["Style No"]])), data_catType))
        catTypeName = list(map(lambda x: x[cat_hdrs_withIdx["Style No"]], data_catType_onlyStyleNo))
#        #### WM row 별 header명 과 짝짓기
        data_withHdrsIdx = list(map(lambda y: list(map(lambda x: y[x], eff_hdrs_v)), data_catType_onlyStyleNo))
        dict_ = list(map(lambda x: dict(zip(eff_hdrs_k, x)), data_withHdrsIdx))
        dicts_final = list(map(lambda y: dict(filter(lambda x: x[1]!=None, y.items())),dict_))

        for oneDict in dicts_final:
            keys = oneDict.keys()
            for i in hdrs_k:
                if i not in keys:
                    oneDict[i] = ""

        return dict(zip(catTypeName,dicts_final))
    
    return dict(zip(row_sep_criteria, map(setDict_OnEachCatType, datas_allCatType)))
    

dictsAIO = get_DataOnRangesAtSheet(sheet, row_sep_criteria)

# Assign your output to the OUT variable.

OUT = dictsAIO

#hdrs_withIdx = find_headersAtSheet(sheet)
#hdrs_v = list(hdrs_withIdx.values())
#hdrs_k = list(hdrs_withIdx.keys())

#rangesATSheet = find_rangesAtSheet_eq(sheet, hdrs_withIdx, "Exterior Wall", row_sep_criteria)
#OUT = rangesATSheet
# ----------------------------------------
values_2 = DesignScript.Builtin.Dictionary.Values(dictionary=parse_roof_style_no_시트_as_dict)
flatten_2 = List.Flatten(list=values_2)
list_create_2 = List.Create(item0=flatten_2)
code_block_7 = CodeBlock()
# ---------- code_block_7.designscript (13 lines) ----------
["Single Door", "Double Door", "Transsom", "Shutter / Sliding / Hanger / Swing / Revolving / Folding"];
5;
 // 시작row 인덱스;
[
"Style No"
,"Style Name (Key Name)"
,"Ref. Door Size"
,"Door"
,"Frame"
,"Vision"
,"Panic"
,"Remark"
];
# ----------------------------------------
parse_door_style_no_시트_as_dict = Python(IN[0]=code_block_2.out3, IN[1]=code_block_7.out0, IN[2]=code_block_7.out1, IN[3]=code_block_7.out2)  # CPython3
# ---------- parse_door_style_no_시트_as_dict.python (144 lines) ----------
# Load the Python Standard and DesignScript Libraries
import sys
import clr
clr.AddReference('ProtoGeometry')
from Autodesk.DesignScript.Geometry import *

from functools import reduce
from functools import partial

import re
# The inputs to this node will be stored as a list in the IN variables.
dataEnteringNode = IN
wholeDatas = IN[0]
dataStartRowIdx = IN[2]
sheet = wholeDatas[dataStartRowIdx:]
row_sep_criteria = IN[1]
headers = IN[3]

# Place your code below this line

def find_IsInStr(target, str):
    if target == None or str == None:
        pass
    else:
        res = target in str
        return res

def find_IsIn_list(target, lst):
    if target == None or str == None:
        pass
    else:
        res = target in lst
        return res

def find_range_by_columnItem(db, col_idx, sep_rule):
    tdb = list(map(lambda x: x[col_idx], db))
    last_idx_tdb = len(tdb)-1
    tdb_enum = enumerate(tdb)
    res = list(filter(lambda x: find_IsInStr(sep_rule, x[1]), tdb_enum))
    endidxs_tmp= list(map(lambda x: x[0]-1,res))
    endidxs_tmp.pop(0)
    endidxs = endidxs_tmp + [last_idx_tdb]
    famTypeNames = list(map(lambda x: x[1],res))
    famTypeNamesIdxs = list(map(lambda x: x[0],res))
    rangeSttIdxs = list(map(lambda x: x[0]+1,res))
    rangeEndIdxs = endidxs
    result = dict(zip(famTypeNames, zip(famTypeNamesIdxs, zip(rangeSttIdxs,rangeEndIdxs))))
    return result

def find_range_by_columnItem_Eq(db, col_idx, row_sep_criteria):
    tdb = list(map(lambda x: x[col_idx], db))
    last_idx_tdb = len(tdb)-1
    tdb_enum = enumerate(tdb)
    res = list(filter(lambda x: find_IsIn_list(x[1], row_sep_criteria), tdb_enum))
    endidxs_tmp= list(map(lambda x: x[0]-1,res))
    endidxs_tmp.pop(0)
    endidxs = endidxs_tmp + [last_idx_tdb]
    famTypeNames = list(map(lambda x: x[1],res))
    famTypeNamesIdxs = list(map(lambda x: x[0],res))
    rangeSttIdxs = list(map(lambda x: x[0]+1,res))
    rangeEndIdxs = endidxs
    result = dict(zip(famTypeNames, zip(famTypeNamesIdxs, zip(rangeSttIdxs,rangeEndIdxs))))
    return result
    
def find_headersAtSheet(sheet):
    headers_sheet = map(lambda x: [x[1].replace("\n",""),x[0]], filter(lambda x: x[1] != None, enumerate(sheet[1])))
    
    return dict(headers_sheet)

def find_rangesAtSheet(sheet, hdrs_withIdx, trgt_hdr, trgt_str):
    return find_range_by_columnItem(sheet, hdrs_withIdx[trgt_hdr], trgt_str)

def find_rangesAtSheet_eq(sheet, hdrs_withIdx, trgt_hdr, row_sep_criteria):
    res = find_range_by_columnItem_Eq(sheet, hdrs_withIdx[trgt_hdr], row_sep_criteria)
    
    return res

def get_DataOnRangesAtSheet(sheet, row_sep_criteria):
    hdrs_withIdx = find_headersAtSheet(sheet)
    rangesATSheet = find_rangesAtSheet_eq(sheet, hdrs_withIdx, "Single Door", row_sep_criteria)
    title_idx = map(lambda x: x[0], rangesATSheet.values())
    catType_colDatas = list(map(lambda x: x[hdrs_withIdx["Single Door"]], sheet))
    catTypes = list(map(lambda x: catType_colDatas[x], title_idx))
    rgs_v = list(map(lambda x: x[1], rangesATSheet.values()))
    rgs_k = list(map(lambda x: x, rangesATSheet.keys()))
    
    datas_allCatType_withSubHdrs = list(map(lambda x: sheet[x[0]-1:x[1]], rgs_v))
    def remove_elem_atIdx(lst, idx):
        del lst[idx]
        return lst 
    datas_allCatType = list(map(lambda x: remove_elem_atIdx(x,1), datas_allCatType_withSubHdrs))
    
    def setDict_OnEachCatType(data_catType):
        cat_hdrsRow = data_catType.pop(0)
        
        cat_hdrs_withIdx_all = dict(map(lambda x: [x[1].replace("\n",""),x[0]], filter(lambda x: x[1] != None, enumerate(cat_hdrsRow))))
        
        hdrs_v = list(cat_hdrs_withIdx_all.values())
        hdrs_k = list(cat_hdrs_withIdx_all.keys())
        eff_hdrs_v = hdrs_v[1:]
        eff_hdrs_k = hdrs_k[1:]
        cat_hdrs_withIdx_originName = dict(list(zip(eff_hdrs_k, eff_hdrs_v)))
        
        cat_hdrs_withIdx = { k.replace(' (Key Name)', ''): v for k, v in cat_hdrs_withIdx_originName.items() }
        
                    
        
        ## 문자 1~2자리 + 숫자 2자리
        p = re.compile('[A-Z]{1,3}\d{2}')
        
        
        data_catType_noneless = list(filter(lambda x: x[cat_hdrs_withIdx["Style No"]] != None, data_catType))
        data_catType_onlyStyleNo = list(filter(lambda x: p.match(str(x[cat_hdrs_withIdx["Style No"]])), data_catType))
        catTypeName = list(map(lambda x: x[cat_hdrs_withIdx["Style No"]], data_catType_onlyStyleNo))
#        #### WM row 별 header명 과 짝짓기
        data_withHdrsIdx = list(map(lambda y: list(map(lambda x: y[x], eff_hdrs_v)), data_catType_onlyStyleNo))
        dict_ = list(map(lambda x: dict(zip(eff_hdrs_k, x)), data_withHdrsIdx))
        dicts_final = list(map(lambda y: dict(filter(lambda x: x[1]!=None, y.items())),dict_))

        for oneDict in dicts_final:
            keys = oneDict.keys()
            for i in hdrs_k:
                if i not in keys:
                    oneDict[i] = ""
                elif i == "Fire Rating":
                    oneDict[i] = ""

        return dict(zip(catTypeName,dicts_final))
    
    return dict(zip(row_sep_criteria, map(setDict_OnEachCatType, datas_allCatType)))
    

dictsAIO = get_DataOnRangesAtSheet(sheet, row_sep_criteria)

# Assign your output to the OUT variable.

OUT = dictsAIO

#hdrs_withIdx = find_headersAtSheet(sheet)
#hdrs_v = list(hdrs_withIdx.values())
#hdrs_k = list(hdrs_withIdx.keys())

#rangesATSheet = find_rangesAtSheet_eq(sheet, hdrs_withIdx, "Exterior Wall", row_sep_criteria)
#OUT = rangesATSheet
# ----------------------------------------
values_3 = DesignScript.Builtin.Dictionary.Values(dictionary=parse_door_style_no_시트_as_dict)
flatten_3 = List.Flatten(list=values_3)
list_create_3 = List.Create(item0=flatten_3)
code_block_8 = CodeBlock()
# ---------- code_block_8.designscript (11 lines) ----------
["Sliding Type", "Awning Type", "Fix Type", "Combination Type", "Skylight", "MISC", "Louver"];
5;
 // 시작row 인덱스;
[
"Style No"
,"Style Name (Key Name)"
,"Ref. Window Size"
,"Glass"
,"Frame"
,"Remark"
];
# ----------------------------------------
parse_window_style_no_시트_as_dict = Python(IN[0]=code_block_2.out4, IN[1]=code_block_8.out0, IN[2]=code_block_8.out1, IN[3]=code_block_8.out2)  # CPython3
# ---------- parse_window_style_no_시트_as_dict.python (148 lines) ----------
# Load the Python Standard and DesignScript Libraries
import sys
import clr
clr.AddReference('ProtoGeometry')
from Autodesk.DesignScript.Geometry import *

from functools import reduce
from functools import partial

import re
# The inputs to this node will be stored as a list in the IN variables.
dataEnteringNode = IN
wholeDatas = IN[0]
dataStartRowIdx = IN[2]
sheet = wholeDatas[dataStartRowIdx:]
row_sep_criteria = IN[1]
headers = IN[3]

# Place your code below this line

def find_IsInStr(target, str):
    if target == None or str == None:
        pass
    else:
        res = target in str
        return res

def find_IsIn_list(target, lst):
    if target == None or str == None:
        pass
    else:
        res = target in lst
        return res

def find_range_by_columnItem(db, col_idx, sep_rule):
    tdb = list(map(lambda x: x[col_idx], db))
    last_idx_tdb = len(tdb)-1
    tdb_enum = enumerate(tdb)
    res = list(filter(lambda x: find_IsInStr(sep_rule, x[1]), tdb_enum))
    endidxs_tmp= list(map(lambda x: x[0]-1,res))
    endidxs_tmp.pop(0)
    endidxs = endidxs_tmp + [last_idx_tdb]
    famTypeNames = list(map(lambda x: x[1],res))
    famTypeNamesIdxs = list(map(lambda x: x[0],res))
    rangeSttIdxs = list(map(lambda x: x[0]+1,res))
    rangeEndIdxs = endidxs
    result = dict(zip(famTypeNames, zip(famTypeNamesIdxs, zip(rangeSttIdxs,rangeEndIdxs))))
    return result

def find_range_by_columnItem_Eq(db, col_idx, row_sep_criteria):
    tdb = list(map(lambda x: x[col_idx], db))
    last_idx_tdb = len(tdb)-1
    tdb_enum = enumerate(tdb)
    res = list(filter(lambda x: find_IsIn_list(x[1], row_sep_criteria), tdb_enum))
    endidxs_tmp= list(map(lambda x: x[0]-1,res))
    endidxs_tmp.pop(0)
    endidxs = endidxs_tmp + [last_idx_tdb]
    famTypeNames = list(map(lambda x: x[1],res))
    famTypeNamesIdxs = list(map(lambda x: x[0],res))
    rangeSttIdxs = list(map(lambda x: x[0]+1,res))
    rangeEndIdxs = endidxs
    result = dict(zip(famTypeNames, zip(famTypeNamesIdxs, zip(rangeSttIdxs,rangeEndIdxs))))
    return result
    
def find_headersAtSheet(sheet):
    headers_sheet = map(lambda x: [x[1].replace("\n",""),x[0]], filter(lambda x: x[1] != None, enumerate(sheet[1])))
    
    return dict(headers_sheet)

def find_rangesAtSheet(sheet, hdrs_withIdx, trgt_hdr, trgt_str):
    return find_range_by_columnItem(sheet, hdrs_withIdx[trgt_hdr], trgt_str)

def find_rangesAtSheet_eq(sheet, hdrs_withIdx, trgt_hdr, row_sep_criteria):
    res = find_range_by_columnItem_Eq(sheet, hdrs_withIdx[trgt_hdr], row_sep_criteria)
    
    return res

def get_DataOnRangesAtSheet(sheet, row_sep_criteria):
    hdrs_withIdx = find_headersAtSheet(sheet)
    rangesATSheet = find_rangesAtSheet_eq(sheet, hdrs_withIdx, "Sliding Type", row_sep_criteria)
    title_idx = map(lambda x: x[0], rangesATSheet.values())
    catType_colDatas = list(map(lambda x: x[hdrs_withIdx["Sliding Type"]], sheet))
    catTypes = list(map(lambda x: catType_colDatas[x], title_idx))
    rgs_v = list(map(lambda x: x[1], rangesATSheet.values()))
    rgs_k = list(map(lambda x: x, rangesATSheet.keys()))
    
    datas_allCatType_withSubHdrs = list(map(lambda x: sheet[x[0]-1:x[1]], rgs_v))
    def remove_elem_atIdx(lst, idx):
        del lst[idx]
        return lst 
    datas_allCatType = list(map(lambda x: remove_elem_atIdx(x,1), datas_allCatType_withSubHdrs))
    
    def setDict_OnEachCatType(data_catType):
        cat_hdrsRow = data_catType.pop(0)
        
        cat_hdrs_withIdx_all = dict(map(lambda x: [x[1].replace("\n",""),x[0]], filter(lambda x: x[1] != None, enumerate(cat_hdrsRow))))
        
        hdrs_v = list(cat_hdrs_withIdx_all.values())
        hdrs_k = list(cat_hdrs_withIdx_all.keys())
        eff_hdrs_v = hdrs_v[1:]
        eff_hdrs_k = hdrs_k[1:]
        cat_hdrs_withIdx_originName = dict(list(zip(eff_hdrs_k, eff_hdrs_v)))
        
        cat_hdrs_withIdx = { k.replace(' (Key Name)', ''): v for k, v in cat_hdrs_withIdx_originName.items() }
        
                    
        
        ## 문자 1~2자리 + 숫자 2자리
        p = re.compile('[A-Z]{1,3}\d{2}')
        
        
        data_catType_noneless = list(filter(lambda x: x[cat_hdrs_withIdx["Style No"]] != None, data_catType))
        data_catType_onlyStyleNo = list(filter(lambda x: p.match(str(x[cat_hdrs_withIdx["Style No"]])), data_catType))
        catTypeName = list(map(lambda x: x[cat_hdrs_withIdx["Style No"]], data_catType_onlyStyleNo))
#        #### WM row 별 header명 과 짝짓기
        data_withHdrsIdx = list(map(lambda y: list(map(lambda x: y[x], eff_hdrs_v)), data_catType_onlyStyleNo))
        dict_ = list(map(lambda x: dict(zip(eff_hdrs_k, x)), data_withHdrsIdx))
        dicts_final = list(map(lambda y: dict(filter(lambda x: x[1]!=None, y.items())),dict_))

        for oneDict in dicts_final:
            keys = oneDict.keys()
            for i in hdrs_k:
                if i not in keys:
                    oneDict[i] = ""
                elif i == "Fire Rating":
                    oneDict[i] = ""

        return dict(zip(catTypeName,dicts_final))
    
    return dict(zip(row_sep_criteria, map(setDict_OnEachCatType, datas_allCatType)))
    

dictsAIO = get_DataOnRangesAtSheet(sheet, row_sep_criteria)

# Assign your output to the OUT variable.

OUT = dictsAIO

#hdrs_withIdx = find_headersAtSheet(sheet)
#hdrs_v = list(hdrs_withIdx.values())
#hdrs_k = list(hdrs_withIdx.keys())

#rangesATSheet = find_rangesAtSheet_eq(sheet, hdrs_withIdx, "Sliding Type", row_sep_criteria)



#catType_colDatas = list(map(lambda x: x[hdrs_withIdx["Sliding Type"]], sheet))
#OUT = catType_colDatas
# ----------------------------------------
values_4 = DesignScript.Builtin.Dictionary.Values(dictionary=parse_window_style_no_시트_as_dict)
flatten_4 = List.Flatten(list=values_4)
list_create_4 = List.Create(item0=flatten_4)
join = List.Join(list0=removeItemAtIndex, list1=list_create, list2=list_create_2, list3=list_create_3, list4=list_create_4)
getItemAtIndex_2 = List.GetItemAtIndex(list=join, index=finish_category_선택)
values_5 = DesignScript.Builtin.Dictionary.Values(dictionary=getItemAtIndex_2)
flatten_5 = List.Flatten(list=values_5)
firstItem = List.FirstItem(list=flatten_5)
keys = DesignScript.Builtin.Dictionary.Keys(dictionary=firstItem)

# group: 선택된 카테고리의 피니시스타일 데이터 정리
code_block_9 = CodeBlock(i=getItemAtIndex_2, j=keys) { i; j; }
keys_2 = DesignScript.Builtin.Dictionary.Keys(dictionary=code_block_9.i)
sort = List.Sort(list=keys_2)
valueAtKey_2 = DesignScript.Builtin.Dictionary.ValueAtKey(dictionary=code_block_9.i, key=sort)
valueAtKey_3 = DesignScript.Builtin.Dictionary.ValueAtKey(dictionary=valueAtKey_2@@L1, key=code_block_9.j)

fields = ScheduleView.Fields(scheduleView=getItemAtIndex)

# group: Key Schedule
code_block_10 = CodeBlock(viewSchedule=getItemAtIndex) { _viewSchedule: var[]..[]; }
code_block_11 = CodeBlock(data=valueAtKey_3) { _data: var[]..[]; }  # frozen
code_block_12 = CodeBlock(parameterNames=fields) { _parameterNames: var[]..[]; }
python_script = Python(IN[0]=code_block_10, IN[1]=code_block_11, IN[2]=code_block_12)  # CPython3
# ---------- python_script.python (69 lines) ----------
#Copyright(c) 2015, Konrad Sobon
# @arch_laboratory, http://archi-lab.net

import clr
clr.AddReference('ProtoGeometry')
from Autodesk.DesignScript.Geometry import *

# Import DocumentManager and TransactionManager
clr.AddReference("RevitServices")
import RevitServices
from RevitServices.Persistence import DocumentManager
from RevitServices.Transactions import TransactionManager

# Import RevitAPI
clr.AddReference("RevitAPI")
import Autodesk
from Autodesk.Revit.DB import *

doc = DocumentManager.Instance.CurrentDBDocument
uiapp = DocumentManager.Instance.CurrentUIApplication
app = uiapp.Application

from System.Collections.Generic import *

# Import ToDSType(bool) extension method
clr.AddReference("RevitNodes")
import Revit
clr.ImportExtensions(Revit.Elements)

#The inputs to this node will be stored as a list in the IN variable.
dataEnteringNode = IN

keySchedule = UnwrapElement(IN[0])
data = IN[1]
inputParams = IN[2]

# "Start" the transaction
TransactionManager.Instance.EnsureInTransaction(doc)

test = []
count = []
cellParams = [[] for i in range(len(data))]
if any(isinstance(item, list) for item in data):
	# process list of lists
	for i in data:
		count.append(len(i))
	colCount = max(count)
	colAvailable = len(keySchedule.Definition.GetSchedulableFields())
	if colCount > colAvailable:
		message = "Please add/remove parameters to/from schedule so that they match longest data set."
	else:
		tableData = keySchedule.GetTableData()
		sectionData = tableData.GetSectionData(SectionType.Body)
		if sectionData.NumberOfRows - 2 <= len(data):
			# schedule by default will have 2 rows (A, B, C and Header Names)
			rowsToAdd = (len(data) - sectionData.NumberOfRows) + 2
			for i in range(0, rowsToAdd, 1):
				sectionData.InsertRow(0)
		else:
			# schedule when updating might already have too many rows 
			rowsToDelete = sectionData.NumberOfRows - 2 - len(data)
			for i in reversed(range(sectionData.NumberOfRows - rowsToDelete, sectionData.NumberOfRows, 1)):
				sectionData.RemoveRow(i)

# "End" the transaction
TransactionManager.Instance.TransactionTaskDone()

#Assign your output to the OUT variable
OUT = keySchedule
# ----------------------------------------
code_block_13 = CodeBlock { _upperCase: bool = false; }
python_script_2 = Python(IN[0]=python_script, IN[1]=code_block_11, IN[2]=code_block_12, IN[3]=code_block_13)  # CPython3
# ---------- python_script_2.python (87 lines) ----------
#Copyright(c) 2015, Konrad Sobon
# @arch_laboratory, http://archi-lab.net

import clr
import sys
clr.AddReference('ProtoGeometry')
from Autodesk.DesignScript.Geometry import *

# Import DocumentManager and TransactionManager
clr.AddReference("RevitServices")
import RevitServices
from RevitServices.Persistence import DocumentManager
from RevitServices.Transactions import TransactionManager

# Import RevitAPI
clr.AddReference("RevitAPI")
import Autodesk
from Autodesk.Revit.DB import *

doc = DocumentManager.Instance.CurrentDBDocument
uiapp = DocumentManager.Instance.CurrentUIApplication
app = uiapp.Application

from System.Collections.Generic import *

# Import ToDSType(bool) extension method
clr.AddReference("RevitNodes")
import Revit
clr.ImportExtensions(Revit.Elements)

pyt_path = r'C:\Program Files (x86)\IronPython 2.7\Lib'
sys.path.append(pyt_path)
import re

#The inputs to this node will be stored as a list in the IN variable.
dataEnteringNode = IN

keySchedule = UnwrapElement(IN[0])
data = IN[1]
inputParams = IN[2]
upper = IN[3]

# "Start" the transaction
TransactionManager.Instance.EnsureInTransaction(doc)

tableData = keySchedule.GetTableData()
sectionData = tableData.GetSectionData(SectionType.Body)

keyNames = []
for i in range(1,sectionData.NumberOfRows - 1,1):
	keyNames.append(str(int(i)))

allKeys = FilteredElementCollector(doc).WhereElementIsNotElementType()
params = [[] for i in range(len(keyNames))]
test = []
for key in allKeys:
	try:
		if key.get_Parameter(BuiltInParameter.REF_TABLE_ELEM_NAME).AsString() in keyNames and key.OwnerViewId == keySchedule.Id:
			indexValue = keyNames.index(key.get_Parameter(BuiltInParameter.REF_TABLE_ELEM_NAME).AsString())
			for i in range(0, len(inputParams),1):
				params[indexValue].extend(key.GetParameters(str(inputParams[i])))
	except:
		pass

for i, j in zip(params, data):
	for param, value in zip(i,j):
		if isinstance(value, str):
			#valueDecoded = value.decode('string_escape')
			valueDecoded = value.encode('utf-8').decode('unicode-escape')
		else:
			if value == None:
				valueDecoded = " "
			else:
				#valueDecoded = str(value).decode('string_escape')
				valueDecoded = str(value).encode('utf-8').decode('unicode-escape')
		if upper:
			valueDecoded = valueDecoded.upper()
			param.Set(valueDecoded)
		else:
			param.Set(valueDecoded)


# "End" the transaction
TransactionManager.Instance.TransactionTaskDone()

#Assign your output to the OUT variable
OUT = keySchedule
# ----------------------------------------
code_block_14 = CodeBlock(viewSchedule=python_script_2) { _viewSchedule; }

code_block_15 = CodeBlock()
# ---------- code_block_15.designscript (13 lines) ----------
["Floor", "Skirting", "Wall", "Ceiling", "Roof", "Exterior Wall"];
2;
 // 시작row 인덱스;
[
"Finish Style Name(Key Name)",
"Finish Style Number",
"Base Material",
"Finish 1(Work Master)",
"Finish 2(Work Master)",
"Finish 3(Work Master)",
"Finish 4(Work Master)",
"Remark"
];
# ----------------------------------------
parse_finish_style_no_시트_as_dict = Python(IN[0]=code_block_2.out0, IN[1]=code_block_15.out0, IN[2]=code_block_15.out1, IN[3]=code_block_15.out2)  # CPython3; frozen
# ---------- parse_finish_style_no_시트_as_dict.python (133 lines) ----------
# Load the Python Standard and DesignScript Libraries
import sys
import clr
clr.AddReference('ProtoGeometry')
from Autodesk.DesignScript.Geometry import *

from functools import reduce
from functools import partial

import re
# The inputs to this node will be stored as a list in the IN variables.
dataEnteringNode = IN
wholeDatas = IN[0]
dataStartRowIdx = IN[2]
sheet = wholeDatas[dataStartRowIdx:]
row_sep_criteria = IN[1]
headers = IN[3]

# Place your code below this line

def find_IsInStr(target, str):
    if target == None or str == None:
        pass
    else:
        res = target in str
        return res

def find_IsIn_list(target, lst):
    if target == None or str == None:
        pass
    else:
        res = target in lst
        return res

def find_range_by_columnItem(db, col_idx, sep_rule):
    tdb = list(map(lambda x: x[col_idx], db))
    last_idx_tdb = len(tdb)-1
    tdb_enum = enumerate(tdb)
    res = list(filter(lambda x: find_IsInStr(sep_rule, x[1]), tdb_enum))
    endidxs_tmp= list(map(lambda x: x[0]-1,res))
    endidxs_tmp.pop(0)
    endidxs = endidxs_tmp + [last_idx_tdb]
    famTypeNames = list(map(lambda x: x[1],res))
    famTypeNamesIdxs = list(map(lambda x: x[0],res))
    rangeSttIdxs = list(map(lambda x: x[0]+1,res))
    rangeEndIdxs = endidxs
    result = dict(zip(famTypeNames, zip(famTypeNamesIdxs, zip(rangeSttIdxs,rangeEndIdxs))))
    return result

def find_range_by_columnItem_Eq(db, col_idx, row_sep_criteria):
    tdb = list(map(lambda x: x[col_idx], db))
    last_idx_tdb = len(tdb)-1
    tdb_enum = enumerate(tdb)
    res = list(filter(lambda x: find_IsIn_list(x[1], row_sep_criteria), tdb_enum))
    endidxs_tmp= list(map(lambda x: x[0]-1,res))
    endidxs_tmp.pop(0)
    endidxs = endidxs_tmp + [last_idx_tdb]
    famTypeNames = list(map(lambda x: x[1],res))
    famTypeNamesIdxs = list(map(lambda x: x[0],res))
    rangeSttIdxs = list(map(lambda x: x[0]+1,res))
    rangeEndIdxs = endidxs
    result = dict(zip(famTypeNames, zip(famTypeNamesIdxs, zip(rangeSttIdxs,rangeEndIdxs))))
    return result
    
def find_headersAtSheet(sheet):
    headers_sheet = map(lambda x: [x[1].replace("\n",""),x[0]], filter(lambda x: x[1] != None, enumerate(sheet[1])))
    
    return dict(headers_sheet)

def find_rangesAtSheet(sheet, hdrs_withIdx, trgt_hdr, trgt_str):
    return find_range_by_columnItem(sheet, hdrs_withIdx[trgt_hdr], trgt_str)

def find_rangesAtSheet_eq(sheet, hdrs_withIdx, trgt_hdr, row_sep_criteria):
    res = find_range_by_columnItem_Eq(sheet, hdrs_withIdx[trgt_hdr], row_sep_criteria)
    
    return res

def get_DataOnRangesAtSheet(sheet, row_sep_criteria):
    hdrs_withIdx = find_headersAtSheet(sheet)
    rangesATSheet = find_rangesAtSheet_eq(sheet, hdrs_withIdx, "Floor", row_sep_criteria)
    title_idx = map(lambda x: x[0], rangesATSheet.values())
    catType_colDatas = list(map(lambda x: x[hdrs_withIdx["Floor"]], sheet))
    catTypes = list(map(lambda x: catType_colDatas[x], title_idx))
    rgs_v = list(map(lambda x: x[1], rangesATSheet.values()))
    rgs_k = list(map(lambda x: x, rangesATSheet.keys()))
    
    hdrs_v = list(hdrs_withIdx.values())
    hdrs_k = list(hdrs_withIdx.keys())
    eff_hdrs_v = hdrs_v[2:]
    eff_hdrs_k = hdrs_k[2:]
    
    datas_allCatType = list(map(lambda x: sheet[x[0]:x[1]], rgs_v))
    
    def setDict_OnEachCatType(data_catType):
        res = {}
    
        ## 문자 1~2자리 + 숫자 2자리
        p = re.compile('[A-Z]{1,2}\d{2}')
        
        
        data_catType_noneless = list(filter(lambda x: x[hdrs_withIdx["Finish Style Number"]] != None, data_catType))
        data_catType_onlyStyleNo = list(filter(lambda x: p.match(str(x[hdrs_withIdx["Finish Style Number"]])), data_catType))
        catTypeName = list(map(lambda x: x[hdrs_withIdx["Finish Style Number"]], data_catType_onlyStyleNo))
        ### WM row 별 header명 과 짝짓기
        data_withHdrsIdx = list(map(lambda y: list(map(lambda x: y[x], eff_hdrs_v)), data_catType_onlyStyleNo))
        dict_ = list(map(lambda x: dict(zip(eff_hdrs_k, x)), data_withHdrsIdx))
        dicts_final = list(map(lambda y: dict(filter(lambda x: x[1]!=None, y.items())),dict_))
        
        
        #for i,k in enumerate(catTypeName):
        #    res[k] = dicts_noneless[i]
        
        return dict(zip(catTypeName,dicts_final))
    
    return dict(zip(row_sep_criteria, map(setDict_OnEachCatType, datas_allCatType)))

dictsAIO = get_DataOnRangesAtSheet(sheet, row_sep_criteria)

def fill_missing(oneCatDicts):
    res = {}
    
    #items_ = oneCatDicts.items()
    for k,v in oneCatDicts.items():
        v["Finish Style Number"] = k
        
        for i in headers:
            if i not in v.keys():
                v[i] = ""
    
    return oneCatDicts
# Assign your output to the OUT variable.

OUT = dict(zip(dictsAIO.keys(),map(fill_missing, dictsAIO.values())))
# ----------------------------------------
keys_3 = DesignScript.Builtin.Dictionary.Keys(dictionary=parse_finish_style_no_시트_as_dict)
code_block_16 = CodeBlock(iii=code_block_2.out2) { iii; }
set_key_order = Python(IN[0]=keys)  # CPython3
# ---------- set_key_order.python (40 lines) ----------
# Load the Python Standard and DesignScript Libraries
import sys
import clr
clr.AddReference('ProtoGeometry')
from Autodesk.DesignScript.Geometry import *

# The inputs to this node will be stored as a list in the IN variables.
dataEnteringNode = IN

keys = IN[0]

# Place your code below this line

def set_key_order(keys):
    res = []
    for i in keys:
        if "Style No" in i:
            res.append([0,i])
        elif "Style Name" in i:
            res.append([1,i])
        elif "Ref." in i:
            res.append([2,i])
        elif "Floor-Base" in i \
            or "Finish-In" in i \
            or "Door" in i\
            or "Glass" in i:
            res.append([3,i])
        elif "Finish-1" in i \
            or "Material-1" in i \
            or "Finish 1" in i\
            or "Frame" in i:
            res.append([4,i])
        elif "Finish-2" in i \
            or "Material-2" in i \
            or "Finish 2" in i\
            or "Vision" in i:
            res.append([5,i])

# Assign your output to the OUT variable.
OUT = 0
# ----------------------------------------
