# Dynamo graph 231107_룸 정보 관리(Eng).DYN "231107_룸 정보 관리(Eng).DYN" (Dynamo 2.13.1.3887)

# group: 배치된 룸 객체 불러오기
rooms_by_status = RoomsByStatus()

# group: 룸 >> Bounding Box 생성 >> Width, Length, Height 추출하기
boundingBox = Element.BoundingBox(element=rooms_by_status.PlacedRooms)
toPolySurface = BoundingBox.ToPolySurface(boundingBox=boundingBox)
surfaces = PolySurface.Surfaces(polySurface=toPolySurface)
code_block = CodeBlock { 2..4..2; 3..5..2; }
getItemAtIndex = List.GetItemAtIndex(list=surfaces, index=code_block.out0, lacing=CrossProduct)
firstItem = List.FirstItem(list=getItemAtIndex@L2)
lastItem = List.LastItem(list=getItemAtIndex@L2)
distanceTo = Geometry.DistanceTo(geometry=firstItem, other=lastItem)
number = DoubleInput(1)
round = Math.Round(number=distanceTo, digits=number)
getItemAtIndex_2 = List.GetItemAtIndex(list=surfaces, index=code_block.out1, lacing=CrossProduct)
firstItem_2 = List.FirstItem(list=getItemAtIndex_2@L2)
lastItem_2 = List.LastItem(list=getItemAtIndex_2@L2)
distanceTo_2 = Geometry.DistanceTo(geometry=firstItem_2, other=lastItem_2)
number_2 = DoubleInput(1)
round_2 = Math.Round(number=distanceTo_2, digits=number_2)

# group: 룸 기준 레벨 불러오기
string = StringInput("Level")
parameterByName = Parameter.ParameterByName(element=rooms_by_status.PlacedRooms, name=string)
value = Parameter.Value(parameter=parameterByName)

# group: 룸 높이 설정
categories = Categories("OST_Levels")
all_elements_of_category = ElementsOfCategory(Category=categories)
elevation = Level.Elevation(level=all_elements_of_category)
round_3 = Math.Round(number=elevation)
sort = List.Sort(list=round_3)
indexOf = List.IndexOf(list=round_3, element=sort)
getItemAtIndex_3 = List.GetItemAtIndex(list=all_elements_of_category, index=indexOf)
count = List.Count(list=getItemAtIndex_3)
code_block_2 = CodeBlock(n=count) { 0..n-2; 1..n-1; }
getItemAtIndex_4 = List.GetItemAtIndex(list=getItemAtIndex_3, index=code_block_2.out1)
elevation_2 = Level.Elevation(level=getItemAtIndex_4)
getItemAtIndex_5 = List.GetItemAtIndex(list=getItemAtIndex_3, index=code_block_2.out0)
elevation_3 = Level.Elevation(level=getItemAtIndex_5)
sub = elevation_2 - elevation_3
round_4 = Math.Round(number=sub)
flatten = List.Flatten(list=round_4)
name = Level.Name(level=getItemAtIndex_3)
indexOf_2 = List.IndexOf(list=name, element=value)
getItemAtIndex_6 = List.GetItemAtIndex(list=flatten, index=indexOf_2)
string_2 = StringInput("Limit Offset")
setParameterByName = Element.SetParameterByName(element=rooms_by_status.PlacedRooms, parameterName=string_2, value=getItemAtIndex_6)

# group: Width, Length, Height
watch_h_room_w = Watch(round)
watch_h_room_l = Watch(round_2)
watch_h_room_h_or_ch = Watch(getItemAtIndex_6)

# group: Room에 매개변수 입력
string_3 = StringInput("H_Room W")
string_4 = StringInput("H_Room L")
string_5 = StringInput("H_Room H or CH")
list_create = List.Create(item0=string_3, item1=string_4, item2=string_5)
list_create_2 = List.Create(item0=watch_h_room_w, item1=watch_h_room_l, item2=watch_h_room_h_or_ch)
transpose = List.Transpose(lists=list_create_2)
count_2 = List.Count(list=transpose)
ofRepeatedItem = List.OfRepeatedItem(item=list_create, amount=count_2)
setParameterByName_2 = Element.SetParameterByName(element=rooms_by_status.PlacedRooms, parameterName=ofRepeatedItem, value=transpose, lacing=Shortest)
convert_by_units = DynamoUnitConvert(transpose, MeasurementType="autodesk.unit.quantity:length-1.0.4", FromConversion="autodesk.unit.unit:millimeters-1.0.1", ToConversion="autodesk.unit.unit:meters-1.0.0")
number_3 = DoubleInput(3)
chop = List.Chop(list=convert_by_units@L2, lengths=number_3)

# group: Building List File Path 입력
file_path = Filename("## 수신\231023\플랜트건축팀_BIM_팀 표준 Building List_박기범_2023.10.19.xlsx")  # graph input

# group: Building List 불러오기 >> Room No. 데이터 추출
building_list_sheet_name = StringInput("Building List")  # graph input
file_from_path = FileObject(path=file_path)
boolean = BoolSelector(false)
importExcel = Data.ImportExcel(file=file_from_path, sheetName=building_list_sheet_name, readAsStrings=boolean)
number_4 = DoubleInput(4)
dropItems = List.DropItems(list=importExcel, amount=number_4)
number_5 = DoubleInput(8)
dropItems_2 = List.DropItems(list=dropItems@L2, amount=number_5)
transpose_2 = List.Transpose(lists=dropItems_2)
firstItem_3 = List.FirstItem(list=transpose_2)

# group: Room 사이즈 측정 : Width, Length, Height >> Excel 내보내기 위한 인덱스 및 데이터 정리
count_3 = List.Count(list=rooms_by_status.PlacedRooms)
code_block_3 = CodeBlock(list=importExcel) { list[3]; }
number_6 = DoubleInput(8)
dropItems_3 = List.DropItems(list=code_block_3, amount=number_6)
string_from_object = FromObject(object=dropItems_3)
string_6 = StringInput("Width")
contains = String.Contains(string=string_from_object, searchFor=string_6)
boolean_2 = BoolSelector(true)
indexOf_3 = List.IndexOf(list=contains, element=boolean_2)
ofRepeatedItem_2 = List.OfRepeatedItem(item=indexOf_3, amount=count_3)
add = ofRepeatedItem_2 + number_6

# group: 룸 번호 불러오기
string_7 = StringInput("Number")
parameterByName_2 = Parameter.ParameterByName(element=rooms_by_status.PlacedRooms, name=string_7)
value_2 = Parameter.Value(parameter=parameterByName_2)
python_script = Python(IN[0]=value_2)  # CPython3
# ---------- python_script.python (19 lines) ----------
# Python 표준 및 DesignScript 라이브러리 로드
import sys
import clr
clr.AddReference('ProtoGeometry')
from Autodesk.DesignScript.Geometry import *

# 이 노드에 대한 입력값은 IN 변수에 리스트로 저장됩니다.
dataEnteringNode = IN

# 코드를 이 선 아래에 배치

number = IN[0]
final = []

for i in range(len(number)):
    final.append(float(number[i]))

# 출력을 OUT 변수에 지정합니다.
OUT = final
# ----------------------------------------

# group: Excel - Building List - Room Number 데이터 및 인덱스 정리
isNull = Object.IsNull(object=firstItem_3)
boolean_3 = BoolSelector(false)
allIndicesOf = List.AllIndicesOf(list=isNull, item=boolean_3)
indexOf_4 = List.IndexOf(list=firstItem_3, element=python_script)
indexOf_5 = List.IndexOf(list=allIndicesOf, element=indexOf_4)
getItemAtIndex_7 = List.GetItemAtIndex(list=allIndicesOf, index=indexOf_5)
add_2 = getItemAtIndex_7 + number_4
# note: Excel - Room Number Index
watch = Watch(add_2)
getItemAtIndex_8 = List.GetItemAtIndex(list=firstItem_3, index=getItemAtIndex_7)
# note: Excel - Room Number
watch_2 = Watch(getItemAtIndex_8)

# group: Interior 정보 불러오기 >> Excel 내보내기 위한 데이터 및 인덱스 정리
string_8 = StringInput("Floor")
eq = string_from_object == string_8  # lacing=CrossProduct
boolean_4 = BoolSelector(true)
indexOf_6 = List.IndexOf(list=eq, element=boolean_4)
add_3 = indexOf_6 + number_6
ofRepeatedItem_3 = List.OfRepeatedItem(item=add_3, amount=count_3)

# group: Excel 팀 표준 데이터 불러오기
string_9 = StringInput("팀 표준 Finish Style")
importExcel_2 = Data.ImportExcel(file=file_from_path, sheetName=string_9)
transpose_3 = List.Transpose(lists=importExcel_2)
code_block_4 = CodeBlock(finish=transpose_3) { finish[2]; finish[3]; }

# group: 마감 재료 >> 코드로 재료 불러오기 >> Excel Import 위한 데이터 정리
join = List.Join()  # unwired: list0, list1
string_10 = StringInput("Floor Finish")
string_11 = StringInput("Base Finish")
string_12 = StringInput("Wall Finish")
string_13 = StringInput("Ceiling Finish")
join_2 = List.Join(list0=string_10, list1=string_11, list2=string_12, list3=string_13)
parameterByName_3 = Parameter.ParameterByName(element=rooms_by_status.PlacedRooms, name=join_2, lacing=CrossProduct)
value_3 = Parameter.Value(parameter=parameterByName_3)
flatten_2 = List.Flatten(list=value_3)
indexOf_7 = List.IndexOf(list=code_block_4.out0, element=value_3)
getItemAtIndex_9 = List.GetItemAtIndex(list=code_block_4.out1, index=indexOf_7)
flatten_3 = List.Flatten(list=getItemAtIndex_9)
combine = List.Combine(combineFunction=join, list0=flatten_2, list1=flatten_3)
count_4 = List.Count(list=indexOf_7@L2)
chop_2 = List.Chop(list=combine, lengths=count_4)
flatten_4 = List.Flatten(list=chop_2@L3)
number_7 = DoubleInput(8)
chop_3 = List.Chop(list=flatten_4@L2, lengths=number_7)

# group: Excel 내보내기
ofRepeatedItem_4 = List.OfRepeatedItem(item=file_path, amount=count_3)
ofRepeatedItem_5 = List.OfRepeatedItem(item=building_list_sheet_name, amount=count_3)
exportToExcel = Data.ExportToExcel(filePath=ofRepeatedItem_4, sheetName=ofRepeatedItem_5, startRow=watch, startColumn=add, data=chop, lacing=Shortest)
exportToExcel_2 = Data.ExportToExcel(filePath=ofRepeatedItem_4, sheetName=ofRepeatedItem_5, startRow=watch, startColumn=ofRepeatedItem_3, data=chop_3)

# group: Revit Room에 이름 입력
string_14 = StringInput("Name")
code_block_5 = CodeBlock(name=transpose_2) { name[1]; }
getItemAtIndex_10 = List.GetItemAtIndex(list=code_block_5, index=indexOf_4)
setParameterByName_3 = Element.SetParameterByName(element=rooms_by_status.PlacedRooms, parameterName=string_14, value=getItemAtIndex_10)
