# Dynamo graph 231109_Bidding Model Automation(Eng).dyn "231109_자동설계(Eng)" (Dynamo 2.13.1.3887)

# group: 그리드 필터
categories = Categories("OST_Grids")
all_elements_of_category = ElementsOfCategory(Category=categories)
string = StringInput("Name")
parameterByName = Parameter.ParameterByName(element=all_elements_of_category, name=string)
value = Parameter.Value(parameter=parameterByName)
string_2 = StringInput("x")
boolean = BoolSelector(true)
contains = String.Contains(string=value, searchFor=string_2, ignoreCase=boolean)
string_3 = StringInput("y")
contains_2 = String.Contains(string=value, searchFor=string_3, ignoreCase=boolean)
eq = contains == contains_2
boolean_2 = BoolSelector(false)
allIndicesOf = List.AllIndicesOf(list=eq, item=boolean_2)
getItemAtIndex = List.GetItemAtIndex(list=all_elements_of_category, index=allIndicesOf)
curve = Grid.Curve(grid=getItemAtIndex)

# group: 그리드 방향 조정 ( + : → ↑ )
startPoint = Curve.StartPoint(curve=curve)
endPoint = Curve.EndPoint(curve=curve)
byTwoPoints = Vector.ByTwoPoints(start=startPoint, end=endPoint)
normalized = Vector.Normalized(vector=byTwoPoints)
X = Vector.X(vector=normalized)
round = Math.Round(number=X)
number = DoubleInput(-1)
eq_2 = round == number
Y = Vector.Y(vector=normalized)
round_2 = Math.Round(number=Y)
eq_3 = round_2 == number
eq_4 = eq_2 == eq_3
filterByBoolMask = List.FilterByBoolMask(list=curve, mask=eq_4)
reverse = Curve.Reverse(curve=filterByBoolMask.out)
join = List.Join(list0=filterByBoolMask.in, list1=reverse)

# group: 그리드 교차점 추출
intersect = Geometry.Intersect(geometry=join, other=join, lacing=CrossProduct)
flatten = List.Flatten(list=intersect)
type = Object.Type(object=flatten)
string_4 = StringInput("point")
boolean_3 = BoolSelector(true)
contains_3 = String.Contains(string=type, searchFor=string_4, ignoreCase=boolean_3)
allIndicesOf_2 = List.AllIndicesOf(list=contains_3, item=boolean_3)
getItemAtIndex_2 = List.GetItemAtIndex(list=flatten, index=allIndicesOf_2)
pruneDuplicates = Point.PruneDuplicates(points=getItemAtIndex_2)

# group: 레벨 데이터 정리
categories_2 = Categories("OST_Levels")
all_elements_of_category_2 = ElementsOfCategory(Category=categories_2)
elevation = Level.Elevation(level=all_elements_of_category_2)
sort = List.Sort(list=elevation)
indexOf = List.IndexOf(list=elevation, element=sort)
getItemAtIndex_3 = List.GetItemAtIndex(list=all_elements_of_category_2, index=indexOf)
count = List.Count(list=getItemAtIndex_3)
code_block = CodeBlock(n=count) { n-1; }
removeItemAtIndex = List.RemoveItemAtIndex(list=getItemAtIndex_3, indices=code_block)
restOfItems = List.RestOfItems(list=getItemAtIndex_3)
lastItem = List.LastItem(list=getItemAtIndex_3)

# group: 벽체 정보 불러오기 (레벨 별)
categories_3 = Categories("OST_Walls")
all_elements_of_category_3 = ElementsOfCategory(Category=categories_3)
getLocation = Element.GetLocation(element=all_elements_of_category_3)
number_2 = DoubleInput(0.5)
pointAtParameter = Curve.PointAtParameter(curve=getLocation, param=number_2)
Z = Point.Z(point=pointAtParameter)
round_3 = Math.Round(number=Z)
uniqueItems = List.UniqueItems(list=round_3)
allIndicesOf_3 = List.AllIndicesOf(list=round_3, item=uniqueItems)
# note: 레벨 별 모든 벽 모델
getItemAtIndex_4 = List.GetItemAtIndex(list=all_elements_of_category_3, index=allIndicesOf_3)
elevation_2 = Level.Elevation(level=removeItemAtIndex)
round_4 = Math.Round(number=elevation_2)
allIndicesOf_4 = List.AllIndicesOf(list=round_3, item=round_4)
# note: 루프층 제외한 벽 모델
getItemAtIndex_5 = List.GetItemAtIndex(list=all_elements_of_category_3, index=allIndicesOf_4)

# group: 기둥 패밀리 선택
select_structural_column_types = StructuralColumnTypes("500 x 500mm")  # graph input

# group: 기둥 모델링
Z_2 = Point.Z(point=pruneDuplicates)
number_3 = DoubleInput(-1)
mul = Z_2 * number_3
translate = Geometry.Translate(geometry=pruneDuplicates, zTranslation=mul, lacing=Shortest)
elevation_3 = Level.Elevation(level=getItemAtIndex_3)
number_4 = DoubleInput(1)
round_5 = Math.Round(number=elevation_3, digits=number_4)
translate_2 = Geometry.Translate(geometry=translate, zTranslation=round_5, lacing=CrossProduct)
byPoints = PolyCurve.ByPoints(points=translate_2)
curves = PolyCurve.Curves(polyCurve=byPoints)
transpose = List.Transpose(lists=curves)
columnByCurve = StructuralFraming.ColumnByCurve(curve=transpose, level=removeItemAtIndex, structuralColumnType=select_structural_column_types)

# group: 그리드 간 교차점으로 그리드 분할 => 보 Curve 작성
intersect_2 = Geometry.Intersect(geometry=join, other=pruneDuplicates, lacing=CrossProduct)
flatten_2 = List.Flatten(list=intersect_2@L3)
parameterAtPoint = Curve.ParameterAtPoint(curve=join, point=flatten_2, lacing=Shortest)
sort_2 = List.Sort(list=parameterAtPoint)
indexOf_2 = List.IndexOf(list=parameterAtPoint, element=sort_2, lacing=Shortest)
getItemAtIndex_6 = List.GetItemAtIndex(list=flatten_2, index=indexOf_2, lacing=Shortest)
byPoints_2 = PolyCurve.ByPoints(points=getItemAtIndex_6)
curves_2 = PolyCurve.Curves(polyCurve=byPoints_2)

# group: 보 패밀리 선택
select_structural_framing_types = StructuralFramingTypes("350 x 700mm")  # graph input

# group: 보 모델링
flatten_3 = List.Flatten(list=curves_2)
elevation_4 = Level.Elevation(level=restOfItems)
number_5 = DoubleInput(1)
round_6 = Math.Round(number=elevation_4, digits=number_5)
translate_3 = Geometry.Translate(geometry=flatten_3, zTranslation=round_6, lacing=CrossProduct)
transpose_2 = List.Transpose(lists=translate_3)
beamByCurve = StructuralFraming.BeamByCurve(curve=transpose_2, level=removeItemAtIndex, structuralFramingType=select_structural_framing_types)
string_5 = StringInput("y Offset Value")
number_6 = DoubleInput(0)
setParameterByName = Element.SetParameterByName(element=beamByCurve, parameterName=string_5, value=number_6, lacing=CrossProduct)

# group: 기초(바닥) 패밀리 선택
select_floor_types = FloorTypes("H_FL_ACS_RC Slab_T150")  # graph input

# group: 지붕 패밀리 선택
roof_types = RoofTypes("H_RF_AMRF_Membrane_Insulation_Protection")  # graph input

# group: 바닥 및 지붕 모델링
join_2 = List.Join()  # unwired: list0, list1, list2
combine = List.Combine(combineFunction=join_2, list0=columnByCurve, list1=getItemAtIndex_5, list2=setParameterByName)
solids = Element.Solids(element=combine)
flatten_4 = List.Flatten(list=solids@L3)
byUnion = Solid.ByUnion(solids=flatten_4)
byGeometry = BoundingBox.ByGeometry(geom=byUnion, lacing=Shortest)
toCuboid = BoundingBox.ToCuboid(boundingBox=byGeometry)
bySolid = PolySurface.BySolid(solid=toCuboid)
surfaces = PolySurface.Surfaces(polySurface=bySolid)
join_3 = List.Join()  # unwired: list0, list1
number_7 = DoubleInput(0.5)
normalAtParameter = Surface.NormalAtParameter(surface=surfaces, u=number_7, v=number_7)
Z_3 = Vector.Z(vector=normalAtParameter)
number_8 = DoubleInput(-1)
eq_5 = Z_3 == number_8
boolean_4 = BoolSelector(true)
allIndicesOf_5 = List.AllIndicesOf(list=eq_5, item=boolean_4, lacing=CrossProduct)
number_9 = DoubleInput(1)
eq_6 = Z_3 == number_9
allIndicesOf_6 = List.AllIndicesOf(list=eq_6, item=boolean_4, lacing=CrossProduct)
combine_2 = List.Combine(combineFunction=join_3, list0=allIndicesOf_5, list1=allIndicesOf_6)
removeItemAtIndex_2 = List.RemoveItemAtIndex(list=surfaces, indices=combine_2, lacing=Shortest)
flatten_5 = List.Flatten(list=removeItemAtIndex_2)
byJoinedSurfaces = PolySurface.ByJoinedSurfaces(surfaces=flatten_5)
getItemAtIndex_7 = List.GetItemAtIndex(list=surfaces, index=allIndicesOf_5, lacing=Shortest)
flatten_6 = List.Flatten(list=getItemAtIndex_7)
perimeterCurves = Surface.PerimeterCurves(surface=flatten_6)
byOutlineTypeAndLevel = Floor.ByOutlineTypeAndLevel(outlineCurves=perimeterCurves, floorType=select_floor_types, level=removeItemAtIndex)
getItemAtIndex_8 = List.GetItemAtIndex(list=surfaces, index=allIndicesOf_6, lacing=Shortest)
flatten_7 = List.Flatten(list=getItemAtIndex_8)
lastItem_2 = List.LastItem(list=flatten_7)
perimeterCurves_2 = Surface.PerimeterCurves(surface=lastItem_2)
byOutlineTypeAndLevel_2 = Roof.ByOutlineTypeAndLevel(outline=perimeterCurves_2, roofType=roof_types, level=lastItem)

# group: 벽체 위치 업데이트 (바닥 Outline 정렬)
list_create = List.Create()  # unwired: item0, item1, item2, item3
solids_2 = Element.Solids(element=getItemAtIndex_4)
flatten_8 = List.Flatten(list=solids_2@L3)
centroid = Solid.Centroid(solid=flatten_8)
X_2 = Point.X(point=centroid)
round_7 = Math.Round(number=X_2)
minimumItem = List.MinimumItem(list=round_7)
allIndicesOf_7 = List.AllIndicesOf(list=round_7, item=minimumItem, lacing=Shortest)
maximumItem = List.MaximumItem(list=round_7)
allIndicesOf_8 = List.AllIndicesOf(list=round_7, item=maximumItem, lacing=Shortest)
Y_2 = Point.Y(point=centroid)
round_8 = Math.Round(number=Y_2)
minimumItem_2 = List.MinimumItem(list=round_8)
allIndicesOf_9 = List.AllIndicesOf(list=round_8, item=minimumItem_2, lacing=Shortest)
maximumItem_2 = List.MaximumItem(list=round_8)
allIndicesOf_10 = List.AllIndicesOf(list=round_8, item=maximumItem_2, lacing=Shortest)
combine_3 = List.Combine(combineFunction=list_create, list0=allIndicesOf_7, list1=allIndicesOf_8, list2=allIndicesOf_9, list3=allIndicesOf_10)
flatten_9 = List.Flatten(list=combine_3@L3)
getItemAtIndex_9 = List.GetItemAtIndex(list=getItemAtIndex_4, index=flatten_9, lacing=Shortest)
getLocation_2 = Element.GetLocation(element=getItemAtIndex_9)
getItemAtIndex_10 = List.GetItemAtIndex(list=centroid, index=flatten_9, lacing=Shortest)
closestPointTo = Geometry.ClosestPointTo(geometry=byJoinedSurfaces, other=getItemAtIndex_10)
X_3 = Point.X(point=closestPointTo)
getItemAtIndex_11 = List.GetItemAtIndex(list=flatten_8, index=flatten_9, lacing=Shortest)
closestPointTo_2 = Geometry.ClosestPointTo(geometry=getItemAtIndex_11, other=closestPointTo, lacing=Shortest)
X_4 = Point.X(point=closestPointTo_2)
sub = X_3 - X_4  # lacing=Shortest
Y_3 = Point.Y(point=closestPointTo)
Y_4 = Point.Y(point=closestPointTo_2)
sub_2 = Y_3 - Y_4  # lacing=Shortest
translate_4 = Geometry.Translate(geometry=getLocation_2, xTranslation=sub, yTranslation=sub_2, lacing=Shortest)
setLocation = Element.SetLocation(element=getItemAtIndex_9, geometry=translate_4, lacing=Shortest)

# group: 객체 우선순위 설정
unjoinAllGeometry = Element.UnjoinAllGeometry(elements=byOutlineTypeAndLevel)
join_4 = List.Join()  # unwired: list0, list1, list2
categories_4 = Categories("OST_Walls")
getIntersectingElementsOfCategory = Element.GetIntersectingElementsOfCategory(element=byOutlineTypeAndLevel, category=categories_4)
categories_5 = Categories("OST_StructuralColumns")
getIntersectingElementsOfCategory_2 = Element.GetIntersectingElementsOfCategory(element=byOutlineTypeAndLevel, category=categories_5)
categories_6 = Categories("OST_StructuralFraming")
getIntersectingElementsOfCategory_3 = Element.GetIntersectingElementsOfCategory(element=byOutlineTypeAndLevel, category=categories_6)
combine_4 = List.Combine(combineFunction=join_4, list0=getIntersectingElementsOfCategory, list1=getIntersectingElementsOfCategory_2, list2=getIntersectingElementsOfCategory_3)
joinGeometry = Element.JoinGeometry(element=unjoinAllGeometry, otherElement=combine_4)

# group: 보 위치 업데이트 (바닥 Outline 정렬)
list_create_2 = List.Create()  # unwired: item0, item1, item2, item3
getLocation_3 = Element.GetLocation(element=setParameterByName)
number_10 = DoubleInput(0.5)
pointAtParameter_2 = Curve.PointAtParameter(curve=getLocation_3, param=number_10)
X_5 = Point.X(point=pointAtParameter_2)
round_9 = Math.Round(number=X_5)
minimumItem_3 = List.MinimumItem(list=round_9)
allIndicesOf_11 = List.AllIndicesOf(list=round_9, item=minimumItem_3, lacing=Shortest)
maximumItem_3 = List.MaximumItem(list=round_9)
allIndicesOf_12 = List.AllIndicesOf(list=round_9, item=maximumItem_3, lacing=Shortest)
Y_5 = Point.Y(point=pointAtParameter_2)
round_10 = Math.Round(number=Y_5)
minimumItem_4 = List.MinimumItem(list=round_10)
allIndicesOf_13 = List.AllIndicesOf(list=round_10, item=minimumItem_4, lacing=Shortest)
maximumItem_4 = List.MaximumItem(list=round_10)
allIndicesOf_14 = List.AllIndicesOf(list=round_10, item=maximumItem_4, lacing=Shortest)
combine_5 = List.Combine(combineFunction=list_create_2, list0=allIndicesOf_11, list1=allIndicesOf_12, list2=allIndicesOf_13, list3=allIndicesOf_14)
flatten_10 = List.Flatten(list=combine_5@L3)
getItemAtIndex_12 = List.GetItemAtIndex(list=setParameterByName, index=flatten_10, lacing=Shortest)
string_6 = StringInput("y Offset Value")
boundingBox = Element.BoundingBox(element=setParameterByName)
toCuboid_2 = BoundingBox.ToCuboid(boundingBox=boundingBox)
getItemAtIndex_13 = List.GetItemAtIndex(list=toCuboid_2, index=flatten_10, lacing=Shortest)
getItemAtIndex_14 = List.GetItemAtIndex(list=toCuboid_2, index=flatten_10, lacing=Shortest)
closestPointTo_3 = Geometry.ClosestPointTo(geometry=byJoinedSurfaces, other=getItemAtIndex_14)
closestPointTo_4 = Geometry.ClosestPointTo(geometry=getItemAtIndex_13, other=closestPointTo_3, lacing=Shortest)
byTwoPoints_2 = Vector.ByTwoPoints(start=closestPointTo_4, end=closestPointTo_3)
X_6 = Vector.X(vector=byTwoPoints_2)
number_11 = DoubleInput(-1)
mul_2 = X_6 * number_11
Y_6 = Vector.Y(vector=byTwoPoints_2)
add = mul_2 + Y_6
setParameterByName_2 = Element.SetParameterByName(element=getItemAtIndex_12, parameterName=string_6, value=add)

# group: 지붕 레벨 조정
string_7 = StringInput("Base Offset From Level")
string_8 = StringInput("Thickness")
parameterByName_2 = Parameter.ParameterByName(element=byOutlineTypeAndLevel_2, name=string_8)
value_2 = Parameter.Value(parameter=parameterByName_2)
number_12 = DoubleInput(-1)
mul_3 = value_2 * number_12
setParameterByName_3 = Element.SetParameterByName(element=byOutlineTypeAndLevel_2, parameterName=string_7, value=mul_3)

# group: 객체 우선순위 설정
unjoinAllGeometry_2 = Element.UnjoinAllGeometry(elements=setParameterByName_3)
lastItem_3 = List.LastItem(list=beamByCurve)
lastItem_4 = List.LastItem(list=getItemAtIndex_5)
lastItem_5 = List.LastItem(list=columnByCurve)
join_5 = List.Join(list0=lastItem_3, list1=lastItem_4, list2=lastItem_5)
joinGeometry_2 = Element.JoinGeometry(element=unjoinAllGeometry_2, otherElement=join_5, lacing=CrossProduct)
flatten_11 = List.Flatten(list=joinGeometry_2@L2)
restOfItems_2 = List.RestOfItems(list=flatten_11@L2)
flatten_12 = List.Flatten(list=restOfItems_2)
setGeometryJoinOrder = Element.SetGeometryJoinOrder(cuttingElement=unjoinAllGeometry_2, otherElement=flatten_12, lacing=CrossProduct)

# group: 기둥 패밀리 선택
select_pedestal_types = StructuralColumnTypes("500 x 500mm")  # graph input

# group: Pedestal 모델링
firstItem = List.FirstItem(list=translate_2@L2)
number_13 = DoubleInput(-2000)
translate_5 = Geometry.Translate(geometry=firstItem, zTranslation=number_13, lacing=CrossProduct)
byStartPointEndPoint = Line.ByStartPointEndPoint(startPoint=translate_5, endPoint=firstItem)
firstItem_2 = List.FirstItem(list=removeItemAtIndex)
columnByCurve_2 = StructuralFraming.ColumnByCurve(curve=byStartPointEndPoint, level=firstItem_2, structuralColumnType=select_pedestal_types)

# group: 독립기초 패밀리 선택
select_foundation_types = FamilyTypes("Foundation Rectangular(Non-Pile):2400 x 2400 x 600mm")  # graph input

# group: 독립 기초 모델링
string_9 = StringInput("Foundation Thickness")
parameterByName_3 = Parameter.ParameterByName(element=select_foundation_types, name=string_9)
value_3 = Parameter.Value(parameter=parameterByName_3)
sub_3 = number_13 - value_3
translate_6 = Geometry.Translate(geometry=firstItem, zTranslation=sub_3, lacing=CrossProduct)
byPointAndLevel = FamilyInstance.ByPointAndLevel(familyType=select_foundation_types, point=translate_6, level=firstItem_2)
