# Dynamo graph Finish Style_injector_rA.dyn "ExcelToRevitSchedule(Finish Style)_rA" (Dynamo 2.16.1.2727)

# group: Filtering Finish Style Schedule
categories = Categories("OST_Schedules")
all_elements_of_category = ElementsOfCategory(Category=categories)
name = Element.Name(element=all_elements_of_category)
iswallfloorbaseceilingstyle = Python(IN[0]=name)  # CPython3
# ---------- iswallfloorbaseceilingstyle.python (28 lines) ----------
# Load the Python Standard and DesignScript Libraries
import sys
import clr
clr.AddReference('ProtoGeometry')
from Autodesk.DesignScript.Geometry import *

# The inputs to this node will be stored as a list in the IN variables.
dataEnteringNode = IN
sch_names_list = IN[0]
# Place your code below this line
tgtList = ["Wall Finish Style", "Floor Finish Style", "Base Finish Style", "Ceiling Finish Style"]

def isInStr(inStr,tgtList):
    tmp = []
    for tgt in tgtList:
        if tgt in inStr:
            tmp.append(True)
        else:
            tmp.append(False)
    return any(tmp)
        

res = list(map(lambda x: isInStr(x, tgtList) , sch_names_list))
    


# Assign your output to the OUT variable.
OUT = res
# ----------------------------------------
filterByBoolMask = List.FilterByBoolMask(list=all_elements_of_category, mask=iswallfloorbaseceilingstyle)

code_block = CodeBlock(i=filterByBoolMask.in) { i[1]; }
code_block_2 = CodeBlock(i=filterByBoolMask.in) { i[2]; }
code_block_3 = CodeBlock(i=filterByBoolMask.in) { i[0]; }
code_block_4 = CodeBlock(i=filterByBoolMask.in) { i[3]; }
list_create = List.Create(item0=code_block, item1=code_block_2, item2=code_block_3, item3=code_block_4)
custom_selection = CustomSelection("Ceiling", items={Floor: "0", Base: "1", Wall: "2", Ceiling: "3"})
getItemAtIndex = List.GetItemAtIndex(list=list_create, index=custom_selection)

# group: Import From Excel
file_path = Filename(".\플랜트건축팀_BIM_팀 표준 Building List_박기범_2023.10.19.xlsx")
file_from_path = FileObject(path=file_path)
code_block_5 = CodeBlock { "팀 표준 Finish Style No 체계"; }
boolean = BoolSelector(true)
importExcel = Data.ImportExcel(file=file_from_path, sheetName=code_block_5, showExcel=boolean)

code_block_6 = CodeBlock()
# ---------- code_block_6.designscript (12 lines) ----------
["Floor", "Skirting", "Wall", "Ceiling"];
2;
[
"Finish Style Name(Key Name)",
"Finish Style Number",
"Base Material",
"Finish 1(Work Master)",
"Finish 2(Work Master)",
"Finish 3(Work Master)",
"Finish 4(Work Master)",
"Remark"
];
# ----------------------------------------
parse_finish_style_no_시트_as_dict = Python(IN[0]=importExcel, IN[1]=code_block_6.out0, IN[2]=code_block_6.out1, IN[3]=code_block_6.out2)  # CPython3
# ---------- parse_finish_style_no_시트_as_dict.python (133 lines) ----------
# Load the Python Standard and DesignScript Libraries
import sys
import clr
clr.AddReference('ProtoGeometry')
from Autodesk.DesignScript.Geometry import *

from functools import reduce
from functools import partial

import re
# The inputs to this node will be stored as a list in the IN variables.
dataEnteringNode = IN
wholeDatas = IN[0]
dataStartRowIdx = IN[2]
sheet = wholeDatas[dataStartRowIdx:]
row_sep_criteria = IN[1]
headers = IN[3]

# Place your code below this line

def find_IsInStr(target, str):
    if target == None or str == None:
        pass
    else:
        res = target in str
        return res

def find_IsIn_list(target, lst):
    if target == None or str == None:
        pass
    else:
        res = target in lst
        return res

def find_range_by_columnItem(db, col_idx, sep_rule):
    tdb = list(map(lambda x: x[col_idx], db))
    last_idx_tdb = len(tdb)-1
    tdb_enum = enumerate(tdb)
    res = list(filter(lambda x: find_IsInStr(sep_rule, x[1]), tdb_enum))
    endidxs_tmp= list(map(lambda x: x[0]-1,res))
    endidxs_tmp.pop(0)
    endidxs = endidxs_tmp + [last_idx_tdb]
    famTypeNames = list(map(lambda x: x[1],res))
    famTypeNamesIdxs = list(map(lambda x: x[0],res))
    rangeSttIdxs = list(map(lambda x: x[0]+1,res))
    rangeEndIdxs = endidxs
    result = dict(zip(famTypeNames, zip(famTypeNamesIdxs, zip(rangeSttIdxs,rangeEndIdxs))))
    return result

def find_range_by_columnItem_Eq(db, col_idx, row_sep_criteria):
    tdb = list(map(lambda x: x[col_idx], db))
    last_idx_tdb = len(tdb)-1
    tdb_enum = enumerate(tdb)
    res = list(filter(lambda x: find_IsIn_list(x[1], row_sep_criteria), tdb_enum))
    endidxs_tmp= list(map(lambda x: x[0]-1,res))
    endidxs_tmp.pop(0)
    endidxs = endidxs_tmp + [last_idx_tdb]
    famTypeNames = list(map(lambda x: x[1],res))
    famTypeNamesIdxs = list(map(lambda x: x[0],res))
    rangeSttIdxs = list(map(lambda x: x[0]+1,res))
    rangeEndIdxs = endidxs
    result = dict(zip(famTypeNames, zip(famTypeNamesIdxs, zip(rangeSttIdxs,rangeEndIdxs))))
    return result
    
def find_headersAtSheet(sheet):
    headers_sheet = map(lambda x: [x[1].replace("\n",""),x[0]], filter(lambda x: x[1] != None, enumerate(sheet[1])))
    
    return dict(headers_sheet)

def find_rangesAtSheet(sheet, hdrs_withIdx, trgt_hdr, trgt_str):
    return find_range_by_columnItem(sheet, hdrs_withIdx[trgt_hdr], trgt_str)

def find_rangesAtSheet_eq(sheet, hdrs_withIdx, trgt_hdr, row_sep_criteria):
    res = find_range_by_columnItem_Eq(sheet, hdrs_withIdx[trgt_hdr], row_sep_criteria)
    
    return res

def get_DataOnRangesAtSheet(sheet, row_sep_criteria):
    hdrs_withIdx = find_headersAtSheet(sheet)
    rangesATSheet = find_rangesAtSheet_eq(sheet, hdrs_withIdx, "Floor", row_sep_criteria)
    title_idx = map(lambda x: x[0], rangesATSheet.values())
    catType_colDatas = list(map(lambda x: x[hdrs_withIdx["Floor"]], sheet))
    catTypes = list(map(lambda x: catType_colDatas[x], title_idx))
    rgs_v = list(map(lambda x: x[1], rangesATSheet.values()))
    rgs_k = list(map(lambda x: x, rangesATSheet.keys()))
    
    hdrs_v = list(hdrs_withIdx.values())
    hdrs_k = list(hdrs_withIdx.keys())
    eff_hdrs_v = hdrs_v[2:]
    eff_hdrs_k = hdrs_k[2:]
    
    datas_allCatType = list(map(lambda x: sheet[x[0]:x[1]], rgs_v))
    
    def setDict_OnEachCatType(data_catType):
        res = {}
    
        ## 문자 1~2자리 + 숫자 2자리
        p = re.compile('[A-Z]{1,2}\d{2}')
        
        
        data_catType_noneless = list(filter(lambda x: x[hdrs_withIdx["Finish Style Number"]] != None, data_catType))
        data_catType_onlyStyleNo = list(filter(lambda x: p.match(str(x[hdrs_withIdx["Finish Style Number"]])), data_catType))
        catTypeName = list(map(lambda x: x[hdrs_withIdx["Finish Style Number"]], data_catType_onlyStyleNo))
        ### WM row 별 header명 과 짝짓기
        data_withHdrsIdx = list(map(lambda y: list(map(lambda x: y[x], eff_hdrs_v)), data_catType_onlyStyleNo))
        dict_ = list(map(lambda x: dict(zip(eff_hdrs_k, x)), data_withHdrsIdx))
        dicts_final = list(map(lambda y: dict(filter(lambda x: x[1]!=None, y.items())),dict_))
        
        
        #for i,k in enumerate(catTypeName):
        #    res[k] = dicts_noneless[i]
        
        return dict(zip(catTypeName,dicts_final))
    
    return dict(zip(row_sep_criteria, map(setDict_OnEachCatType, datas_allCatType)))

dictsAIO = get_DataOnRangesAtSheet(sheet, row_sep_criteria)

def fill_missing(oneCatDicts):
    res = {}
    
    #items_ = oneCatDicts.items()
    for k,v in oneCatDicts.items():
        v["Finish Style Number"] = k
        
        for i in headers:
            if i not in v.keys():
                v[i] = ""
    
    return oneCatDicts
# Assign your output to the OUT variable.

OUT = dict(zip(dictsAIO.keys(),map(fill_missing, dictsAIO.values())))
# ----------------------------------------
valueAtKey = DesignScript.Builtin.Dictionary.ValueAtKey(dictionary=parse_finish_style_no_시트_as_dict, key=code_block_6.out0)
getItemAtIndex_2 = List.GetItemAtIndex(list=valueAtKey, index=custom_selection)
code_block_7 = CodeBlock(i=getItemAtIndex_2, j=code_block_6.out2) { i; j; }
keys = DesignScript.Builtin.Dictionary.Keys(dictionary=code_block_7.i)
sort = List.Sort(list=keys)
valueAtKey_2 = DesignScript.Builtin.Dictionary.ValueAtKey(dictionary=code_block_7.i, key=sort)
valueAtKey_3 = DesignScript.Builtin.Dictionary.ValueAtKey(dictionary=valueAtKey_2@@L1, key=code_block_7.j)
fields = ScheduleView.Fields(scheduleView=getItemAtIndex)

# group: Key Schedule
code_block_8 = CodeBlock(viewSchedule=getItemAtIndex) { _viewSchedule: var[]..[]; }
code_block_9 = CodeBlock(data=valueAtKey_3) { _data: var[]..[]; }
code_block_10 = CodeBlock(parameterNames=fields) { _parameterNames: var[]..[]; }
python_script = Python(IN[0]=code_block_8, IN[1]=code_block_9, IN[2]=code_block_10)  # CPython3
# ---------- python_script.python (69 lines) ----------
#Copyright(c) 2015, Konrad Sobon
# @arch_laboratory, http://archi-lab.net

import clr
clr.AddReference('ProtoGeometry')
from Autodesk.DesignScript.Geometry import *

# Import DocumentManager and TransactionManager
clr.AddReference("RevitServices")
import RevitServices
from RevitServices.Persistence import DocumentManager
from RevitServices.Transactions import TransactionManager

# Import RevitAPI
clr.AddReference("RevitAPI")
import Autodesk
from Autodesk.Revit.DB import *

doc = DocumentManager.Instance.CurrentDBDocument
uiapp = DocumentManager.Instance.CurrentUIApplication
app = uiapp.Application

from System.Collections.Generic import *

# Import ToDSType(bool) extension method
clr.AddReference("RevitNodes")
import Revit
clr.ImportExtensions(Revit.Elements)

#The inputs to this node will be stored as a list in the IN variable.
dataEnteringNode = IN

keySchedule = UnwrapElement(IN[0])
data = IN[1]
inputParams = IN[2]

# "Start" the transaction
TransactionManager.Instance.EnsureInTransaction(doc)

test = []
count = []
cellParams = [[] for i in range(len(data))]
if any(isinstance(item, list) for item in data):
	# process list of lists
	for i in data:
		count.append(len(i))
	colCount = max(count)
	colAvailable = len(keySchedule.Definition.GetSchedulableFields())
	if colCount > colAvailable:
		message = "Please add/remove parameters to/from schedule so that they match longest data set."
	else:
		tableData = keySchedule.GetTableData()
		sectionData = tableData.GetSectionData(SectionType.Body)
		if sectionData.NumberOfRows - 2 <= len(data):
			# schedule by default will have 2 rows (A, B, C and Header Names)
			rowsToAdd = (len(data) - sectionData.NumberOfRows) + 2
			for i in range(0, rowsToAdd, 1):
				sectionData.InsertRow(0)
		else:
			# schedule when updating might already have too many rows 
			rowsToDelete = sectionData.NumberOfRows - 2 - len(data)
			for i in reversed(range(sectionData.NumberOfRows - rowsToDelete, sectionData.NumberOfRows, 1)):
				sectionData.RemoveRow(i)

# "End" the transaction
TransactionManager.Instance.TransactionTaskDone()

#Assign your output to the OUT variable
OUT = keySchedule
# ----------------------------------------
code_block_11 = CodeBlock { _upperCase: bool = false; }
python_script_2 = Python(IN[0]=python_script, IN[1]=code_block_9, IN[2]=code_block_10, IN[3]=code_block_11)  # CPython3
# ---------- python_script_2.python (87 lines) ----------
#Copyright(c) 2015, Konrad Sobon
# @arch_laboratory, http://archi-lab.net

import clr
import sys
clr.AddReference('ProtoGeometry')
from Autodesk.DesignScript.Geometry import *

# Import DocumentManager and TransactionManager
clr.AddReference("RevitServices")
import RevitServices
from RevitServices.Persistence import DocumentManager
from RevitServices.Transactions import TransactionManager

# Import RevitAPI
clr.AddReference("RevitAPI")
import Autodesk
from Autodesk.Revit.DB import *

doc = DocumentManager.Instance.CurrentDBDocument
uiapp = DocumentManager.Instance.CurrentUIApplication
app = uiapp.Application

from System.Collections.Generic import *

# Import ToDSType(bool) extension method
clr.AddReference("RevitNodes")
import Revit
clr.ImportExtensions(Revit.Elements)

pyt_path = r'C:\Program Files (x86)\IronPython 2.7\Lib'
sys.path.append(pyt_path)
import re

#The inputs to this node will be stored as a list in the IN variable.
dataEnteringNode = IN

keySchedule = UnwrapElement(IN[0])
data = IN[1]
inputParams = IN[2]
upper = IN[3]

# "Start" the transaction
TransactionManager.Instance.EnsureInTransaction(doc)

tableData = keySchedule.GetTableData()
sectionData = tableData.GetSectionData(SectionType.Body)

keyNames = []
for i in range(1,sectionData.NumberOfRows - 1,1):
	keyNames.append(str(int(i)))

allKeys = FilteredElementCollector(doc).WhereElementIsNotElementType()
params = [[] for i in range(len(keyNames))]
test = []
for key in allKeys:
	try:
		if key.get_Parameter(BuiltInParameter.REF_TABLE_ELEM_NAME).AsString() in keyNames and key.OwnerViewId == keySchedule.Id:
			indexValue = keyNames.index(key.get_Parameter(BuiltInParameter.REF_TABLE_ELEM_NAME).AsString())
			for i in range(0, len(inputParams),1):
				params[indexValue].extend(key.GetParameters(str(inputParams[i])))
	except:
		pass

for i, j in zip(params, data):
	for param, value in zip(i,j):
		if isinstance(value, str):
			#valueDecoded = value.decode('string_escape')
			valueDecoded = value.encode('utf-8').decode('unicode-escape')
		else:
			if value == None:
				valueDecoded = " "
			else:
				#valueDecoded = str(value).decode('string_escape')
				valueDecoded = str(value).encode('utf-8').decode('unicode-escape')
		if upper:
			valueDecoded = valueDecoded.upper()
			param.Set(valueDecoded)
		else:
			param.Set(valueDecoded)


# "End" the transaction
TransactionManager.Instance.TransactionTaskDone()

#Assign your output to the OUT variable
OUT = keySchedule
# ----------------------------------------
code_block_12 = CodeBlock(viewSchedule=python_script_2) { _viewSchedule; }

parse_finish_style_no_시트_old = Python(IN[0]=importExcel, IN[1]=code_block_6.out0, IN[2]=code_block_6.out1, IN[3]=code_block_6.out2)  # CPython3
# ---------- parse_finish_style_no_시트_old.python (122 lines) ----------
# Load the Python Standard and DesignScript Libraries
import sys
import clr
clr.AddReference('ProtoGeometry')
from Autodesk.DesignScript.Geometry import *

from functools import reduce
from functools import partial

import re
# The inputs to this node will be stored as a list in the IN variables.
dataEnteringNode = IN
wholeDatas = IN[0]
dataStartRowIdx = IN[2]
sheet = wholeDatas[dataStartRowIdx:]
row_sep_criteria = IN[1]
headers = IN[3]

# Place your code below this line

def find_IsInStr(target, str):
    if target == None or str == None:
        pass
    else:
        res = target in str
        return res

def find_IsIn_list(target, lst):
    if target == None or str == None:
        pass
    else:
        res = target in lst
        return res

def find_range_by_columnItem(db, col_idx, sep_rule):
    tdb = list(map(lambda x: x[col_idx], db))
    last_idx_tdb = len(tdb)-1
    tdb_enum = enumerate(tdb)
    res = list(filter(lambda x: find_IsInStr(sep_rule, x[1]), tdb_enum))
    endidxs_tmp= list(map(lambda x: x[0]-1,res))
    endidxs_tmp.pop(0)
    endidxs = endidxs_tmp + [last_idx_tdb]
    famTypeNames = list(map(lambda x: x[1],res))
    famTypeNamesIdxs = list(map(lambda x: x[0],res))
    rangeSttIdxs = list(map(lambda x: x[0]+1,res))
    rangeEndIdxs = endidxs
    result = dict(zip(famTypeNames, zip(famTypeNamesIdxs, zip(rangeSttIdxs,rangeEndIdxs))))
    return result

def find_range_by_columnItem_Eq(db, col_idx, row_sep_criteria):
    tdb = list(map(lambda x: x[col_idx], db))
    last_idx_tdb = len(tdb)-1
    tdb_enum = enumerate(tdb)
    res = list(filter(lambda x: find_IsIn_list(x[1], row_sep_criteria), tdb_enum))
    endidxs_tmp= list(map(lambda x: x[0]-1,res))
    endidxs_tmp.pop(0)
    endidxs = endidxs_tmp + [last_idx_tdb]
    famTypeNames = list(map(lambda x: x[1],res))
    famTypeNamesIdxs = list(map(lambda x: x[0],res))
    rangeSttIdxs = list(map(lambda x: x[0]+1,res))
    rangeEndIdxs = endidxs
    result = dict(zip(famTypeNames, zip(famTypeNamesIdxs, zip(rangeSttIdxs,rangeEndIdxs))))
    return result
    
def find_headersAtSheet(sheet):
    headers_sheet = map(lambda x: [x[1].replace("\n",""),x[0]], filter(lambda x: x[1] != None, enumerate(sheet[1])))
    
    return dict(headers_sheet)

def find_rangesAtSheet(sheet, hdrs_withIdx, trgt_hdr, trgt_str):
    return find_range_by_columnItem(sheet, hdrs_withIdx[trgt_hdr], trgt_str)

def find_rangesAtSheet_eq(sheet, hdrs_withIdx, trgt_hdr, row_sep_criteria):
    res = find_range_by_columnItem_Eq(sheet, hdrs_withIdx[trgt_hdr], row_sep_criteria)
    
    return res

def get_DataOnRangesAtSheet(sheet, row_sep_criteria):
    hdrs_withIdx = find_headersAtSheet(sheet)
    rangesATSheet = find_rangesAtSheet_eq(sheet, hdrs_withIdx, "Floor", row_sep_criteria)
    title_idx = map(lambda x: x[0], rangesATSheet.values())
    catType_colDatas = list(map(lambda x: x[hdrs_withIdx["Floor"]], sheet))
    catTypes = list(map(lambda x: catType_colDatas[x], title_idx))
    rgs_v = list(map(lambda x: x[1], rangesATSheet.values()))
    rgs_k = list(map(lambda x: x, rangesATSheet.keys()))
    
    hdrs_v = list(hdrs_withIdx.values())
    hdrs_k = list(hdrs_withIdx.keys())
    eff_hdrs_v = hdrs_v[2:]
    eff_hdrs_k = hdrs_k[2:]
    
    datas_allCatType = list(map(lambda x: sheet[x[0]:x[1]], rgs_v))
    
    def setDict_OnEachCatType(data_catType):
        res = {}
    
        ## 문자 1~2자리 + 숫자 2자리
        p = re.compile('[A-Z]{1,2}\d{2}')
        
        
        data_catType_noneless = list(filter(lambda x: x[hdrs_withIdx["Finish Style Number"]] != None, data_catType))
        data_catType_onlyStyleNo = list(filter(lambda x: p.match(str(x[hdrs_withIdx["Finish Style Number"]])), data_catType))
        catTypeName = list(map(lambda x: x[hdrs_withIdx["Finish Style Number"]], data_catType_onlyStyleNo))
        ### WM row 별 header명 과 짝짓기
        data_withHdrsIdx = list(map(lambda y: list(map(lambda x: y[x], eff_hdrs_v)), data_catType_onlyStyleNo))
        dict_ = list(map(lambda x: dict(zip(eff_hdrs_k, x)), data_withHdrsIdx))
        dicts_final = list(map(lambda y: dict(filter(lambda x: x[1]!=None, y.items())),dict_))
        
        
        #for i,k in enumerate(catTypeName):
        #    res[k] = dicts_noneless[i]
        
        return dict(zip(catTypeName,dicts_final))
    
    return dict(zip(row_sep_criteria, map(setDict_OnEachCatType, datas_allCatType)))

dictsAIO = get_DataOnRangesAtSheet(sheet, row_sep_criteria)


# Assign your output to the OUT variable.

OUT = dictsAIO
# ----------------------------------------
code_block_13 = CodeBlock(i=valueAtKey) { i[0]; i[1]; i[2]; i[3]; }
