# Dynamo graph 4_.dyn (Dynamo 2.10.1.3976)

code_block = CodeBlock()
# ---------- code_block.designscript (4 lines) ----------
{
"a": 1,
"b": 2
};
# ----------------------------------------
code_block_2 = CodeBlock(a=code_block) { a; b = a["b"]; }
categories = Categories("OST_Rooms")
all_elements_of_category = ElementsOfCategory(Category=categories)
parameters = Element.Parameters(element=all_elements_of_category)
file_path = Filename("C:\Users\pjmk0\Downloads\MK\mQ\hecBidding\test1.xslx")
code_block_3 = CodeBlock { "Sheet1"; }
code_block_4 = CodeBlock { 0; }
addItemToFront = List.AddItemToFront()  # unwired: item, list
code_block_5 = CodeBlock()
# ---------- code_block_5.designscript (7 lines) ----------
[
"A",
"B",
"C",
"D",
"E"
];
# ----------------------------------------
name = Element.Name(element=all_elements_of_category)
code_block_6 = CodeBlock { "Department"; }
getParameterValueByName = Element.GetParameterValueByName(element=all_elements_of_category, parameterName=code_block_6)
code_block_7 = CodeBlock { "Interior Finish"; }
getParameterValueByName_2 = Element.GetParameterValueByName(element=all_elements_of_category, parameterName=code_block_7)
code_block_8 = CodeBlock { "Exterior Finish"; }
getParameterValueByName_3 = Element.GetParameterValueByName(element=all_elements_of_category, parameterName=code_block_8)
code_block_9 = CodeBlock { "Area"; }
getParameterValueByName_4 = Element.GetParameterValueByName(element=all_elements_of_category, parameterName=code_block_9)
code_block_10 = CodeBlock { "Perimeter"; }
getParameterValueByName_5 = Element.GetParameterValueByName(element=all_elements_of_category, parameterName=code_block_10)
code_block_11 = CodeBlock(t1=getParameterValueByName_5) { num2 = Math.Round(t1, 1)/1000; }
list_create = List.Create(item0=name, item1=getParameterValueByName, item2=getParameterValueByName_2, item3=getParameterValueByName_3, item4=getParameterValueByName_4, item5=code_block_11)
transpose = List.Transpose(lists=list_create)
watch = Watch(transpose)
cartesianProduct = List.CartesianProduct(combineFunction=addItemToFront, list0=code_block_5, list1=watch)
code_block_12 = CodeBlock { 1; }
flatten = List.Flatten(list=cartesianProduct, amt=code_block_12)
code_block_13 = CodeBlock { true; }
exportExcel = Data.ExportExcel(filePath=file_path, sheetName=code_block_3, startRow=code_block_4, startCol=code_block_4, data=flatten, overWrite=code_block_13)
