# Dynamo graph 4_Bidding Quantity Calculation.dyn (Dynamo 2.10.1.3976)

code_block = CodeBlock()
# ---------- code_block.designscript (4 lines) ----------
{
"a": 1,
"b": 2
};
# ----------------------------------------
code_block_2 = CodeBlock(a=code_block) { a; b = a["b"]; }
categories = Categories("OST_Rooms")
all_elements_of_category = ElementsOfCategory(Category=categories)
parameters = Element.Parameters(element=all_elements_of_category)
addItemToFront = List.AddItemToFront()  # unwired: item, list
code_block_3 = CodeBlock()
# ---------- code_block_3.designscript (7 lines) ----------
[
"A",
"B",
"C",
"D",
"E"
];
# ----------------------------------------
name = Element.Name(element=all_elements_of_category)
code_block_4 = CodeBlock { "Department"; }
getParameterValueByName = Element.GetParameterValueByName(element=all_elements_of_category, parameterName=code_block_4)
code_block_5 = CodeBlock { "Interior Finish"; }
getParameterValueByName_2 = Element.GetParameterValueByName(element=all_elements_of_category, parameterName=code_block_5)
code_block_6 = CodeBlock { "Exterior Finish"; }
getParameterValueByName_3 = Element.GetParameterValueByName(element=all_elements_of_category, parameterName=code_block_6)
code_block_7 = CodeBlock { "Area"; }
getParameterValueByName_4 = Element.GetParameterValueByName(element=all_elements_of_category, parameterName=code_block_7)
code_block_8 = CodeBlock(t1=getParameterValueByName_4) { num2 = (Math.Round(t1, 2)/1); }
code_block_9 = CodeBlock { "Perimeter"; }
getParameterValueByName_5 = Element.GetParameterValueByName(element=all_elements_of_category, parameterName=code_block_9)
code_block_10 = CodeBlock(t1=getParameterValueByName_5) { num2 = (Math.Round(t1, 2)/1000); }
list_create = List.Create(item0=name, item1=getParameterValueByName, item2=getParameterValueByName_2, item3=getParameterValueByName_3, item4=code_block_8, item5=code_block_10)
transpose = List.Transpose(lists=list_create)
watch = Watch(transpose)
cartesianProduct = List.CartesianProduct(combineFunction=addItemToFront, list0=code_block_3, list1=watch)
code_block_11 = CodeBlock { 1; }
flatten = List.Flatten(list=cartesianProduct, amt=code_block_11)
code_block_12 = CodeBlock { "Unbounded Height"; }
getParameterValueByName_6 = Element.GetParameterValueByName(element=all_elements_of_category, parameterName=code_block_12)
uniqueItems = List.UniqueItems(list=getParameterValueByName_6)
firstItem = List.FirstItem(list=uniqueItems)
watch_2 = Watch(getParameterValueByName_2)

# group: Interior Finish Type define
interior_finish_type = CodeBlock()
# ---------- interior_finish_type.designscript (9 lines) ----------
[
"NA",
"IF1",
"IF2",
"IF2-1",
"IF3",
"IF4",
"IF5"
];
# ----------------------------------------
interior_finish_floor = CodeBlock()
# ---------- interior_finish_floor.designscript (9 lines) ----------
[
["na...na...na"],
["A04AL080-00006...Epoxy paint...M2"],
["A04AM083-00004...Vinyl Tile...M2"],
["A04AM083-00004...Vinyl Tile...M2"],
["A04AM083-00005...Anti-Static Vinyl Tile...M2"],
["A04AL080-00003...Acid/Alkaline Resistant Paint...M2"],
["A04AM083-00001...Ceramic Tile...M2", "A04AN000-00001...Waterproofing Membrane...M2"]
];
# ----------------------------------------
interior_finish_wall = CodeBlock()
# ---------- interior_finish_wall.designscript (12 lines) ----------
[
["na...na...na"],
["A04AL078-00003...Latex Paint...M2"],
["A04AL078-00003...Latex Paint...M2"],
["A04AL078-00003...Latex Paint...M2"],
["A04AL078-00003...Latex Paint...M2"],
["A04AL078-00004...Acid/Alkaline Resistant Paint, H=1.5...M2",
"A04AL078-00003...Latex Paint...M2"],
["A04AM082-00002...Glazed Ceramic Tile, H=1.8...M2",
"A04AN000-00001...Waterproofing Membrane, H=1.8m...M2",
"A04AL078-00003...Latex Paint...M2"]
];
# ----------------------------------------
interior_finish_skirt = CodeBlock()
# ---------- interior_finish_skirt.designscript (9 lines) ----------
[
["na...na...na"],
["A04AL081-00007...Epoxy paint H=100...M"],
["A04AR151-00001...Coved Rubber Skirting, H=100...M"],
["A04AR151-00001...Coved Rubber Skirting, H=100...M"],
["A04AR151-00001...Coved Rubber Skirting, H=100...M"],
["A04AL081-00004...Acid/Alkaline Resistant Paint H=100...M"],
["A04AM084-00004...Glazed Ceramic Tile, H=100...M"]
];
# ----------------------------------------
interior_finish_ceiling = CodeBlock()
# ---------- interior_finish_ceiling.designscript (9 lines) ----------
[
["na...na...na"],
["A04AL079-00003...Latex Paint...M2"],
["A04AL079-00003...Latex Paint...M2"],
["A04AR156-00002...Acoustic Tiled Ceiling System, T-Bar...M2"],
["A04AR156-00002...Acoustic Tiled Ceiling System, T-Bar...M2"],
["A04AL079-00003...Latex Paint...M2"],
["A04AR157-00002...Moisture Resistant Tiled Ceiling System, T-bar...M2"]
];
# ----------------------------------------

allIndicesOf = List.AllIndicesOf(list=watch_2, item=interior_finish_type)
code_block_13 = CodeBlock { "..."; }
split = String.Split(separator0=code_block_13)  # unwired: str
lastItem = List.LastItem(list=split@L2)

# group: WM 별 계산 수식 매칭 구간
interior_finish_floor_calc = CodeBlock()
# ---------- interior_finish_floor_calc.designscript (9 lines) ----------
[
[0],//NA
[1],
[1],
[1],
[1],
[1],
[1]
];
# ----------------------------------------
code_block_14 = CodeBlock(i=interior_finish_floor, j=interior_finish_floor_calc) { i + "..." + j; }
watch_3 = Watch(code_block_14)
code_block_15 = CodeBlock { 4; }
interior_finish_wall_calc = CodeBlock(h=code_block_15)
# ---------- interior_finish_wall_calc.designscript (12 lines) ----------
[
[0],
[h],
[h],
[h],
[h],
[1.5,
(h-1.5)],
[1.8,
1.8,
(h-1.8)]
];
# ----------------------------------------
code_block_16 = CodeBlock(i=interior_finish_wall, j=interior_finish_wall_calc) { i + "..." + j; }
watch_4 = Watch(code_block_16)
interior_finish_skirt_calc = CodeBlock()
# ---------- interior_finish_skirt_calc.designscript (9 lines) ----------
[
[0],
[1],
[1],
[1],
[1],
[1],
[1]
];
# ----------------------------------------
code_block_17 = CodeBlock(i=interior_finish_skirt, j=interior_finish_skirt_calc) { i + "..." + j; }
watch_5 = Watch(code_block_17)
interior_finish_ceiling_calc = CodeBlock()  # same code as interior_finish_skirt_calc
code_block_18 = CodeBlock(i=interior_finish_ceiling, j=interior_finish_ceiling_calc) { i + "..." + j; }
watch_6 = Watch(code_block_18)

# group (continued): Interior Finish Type define
dictionary_bykeysvalues_floor = DesignScript.Builtin.Dictionary.ByKeysValues(keys=interior_finish_type, values=watch_3)
dictionary_bykeysvalues_wall = DesignScript.Builtin.Dictionary.ByKeysValues(keys=interior_finish_type, values=watch_4)
dictionary_bykeysvalues_skirt = DesignScript.Builtin.Dictionary.ByKeysValues(keys=interior_finish_type, values=watch_5)
dictionary_bykeysvalues_ceiling = DesignScript.Builtin.Dictionary.ByKeysValues(keys=interior_finish_type, values=watch_6)

# group: 개체별 해당 WM 부여
watch_7 = Watch(getParameterValueByName_2)
valueAtKey = DesignScript.Builtin.Dictionary.ValueAtKey(dictionary=dictionary_bykeysvalues_floor, key=watch_7)
watch_wm_floor = Watch(valueAtKey)
valueAtKey_2 = DesignScript.Builtin.Dictionary.ValueAtKey(dictionary=dictionary_bykeysvalues_wall, key=watch_7)
watch_wm_wall = Watch(valueAtKey_2)
valueAtKey_3 = DesignScript.Builtin.Dictionary.ValueAtKey(dictionary=dictionary_bykeysvalues_skirt, key=watch_7)
watch_wm_skirt = Watch(valueAtKey_3)
valueAtKey_4 = DesignScript.Builtin.Dictionary.ValueAtKey(dictionary=dictionary_bykeysvalues_ceiling, key=watch_7)
watch_wm_ceiling = Watch(valueAtKey_4)

watch_wm_floor_2 = Watch(valueAtKey)
firstItem_2 = List.FirstItem(list=split@L2)
contains = String.Contains(str=watch_wm_floor_2, searchFor=firstItem_2@L1)  # frozen
code_block_19 = CodeBlock { true; }
allIndicesOf_2 = List.AllIndicesOf(list=contains@L2, item=code_block_19)
indexOf = List.IndexOf(list=contains@L2, element=code_block_19)
file_path = Filename(".\test1.xslx")
code_block_20 = CodeBlock { "Sheet1"; }
code_block_21 = CodeBlock { 0; }
watch_room_name = Watch(name)
watch_department = Watch(getParameterValueByName)

# group: WM 개수당 개체 복제 후 매칭<Floor>
count = List.Count(list=watch_wm_floor@L2)
ofRepeatedItem = List.OfRepeatedItem(item=watch_7@L1, amount=count@L1)
code_block_22 = CodeBlock(a=ofRepeatedItem, b=watch_wm_floor) { a + "..." + b; }

# group: WM 개수당 개체 복제 후 매칭<Floor>
count_2 = List.Count(list=code_block_22@L2)
ofRepeatedItem_2 = List.OfRepeatedItem(item=watch_department@L1, amount=count_2@L1)
code_block_23 = CodeBlock(a=ofRepeatedItem_2, b=code_block_22) { a + "..." + b; }

# group: WM 개수당 개체 복제 후 매칭<Floor>
count_3 = List.Count(list=code_block_23@L2)
ofRepeatedItem_3 = List.OfRepeatedItem(item=watch_room_name@L1, amount=count_3@L1)
code_block_24 = CodeBlock(a=ofRepeatedItem_3, b=code_block_23) { a + "..." + b; }

watch_8 = Watch(code_block_24)
watch_room_area = Watch(code_block_8)

# group: WM 개수당 개체 복제 후 매칭<Floor>
count_4 = List.Count(list=watch_8@L2)
ofRepeatedItem_4 = List.OfRepeatedItem(item=watch_room_area@L1, amount=count_4@L1)
code_block_25 = CodeBlock(b=watch_8, a=ofRepeatedItem_4) { b + "..." + a; }

watch_9 = Watch(code_block_25)

# group: WM 개수당 개체 복제 후 매칭<Wall>
count_5 = List.Count(list=watch_wm_wall@L2)
ofRepeatedItem_5 = List.OfRepeatedItem(item=watch_7@L1, amount=count_5@L1)
code_block_26 = CodeBlock(a=ofRepeatedItem_5, b=watch_wm_wall) { a + "..." + b; }

# group: WM 개수당 개체 복제 후 매칭<Wall>
count_6 = List.Count(list=code_block_26@L2)
ofRepeatedItem_6 = List.OfRepeatedItem(item=watch_department@L1, amount=count_6@L1)
code_block_27 = CodeBlock(a=ofRepeatedItem_6, b=code_block_26) { a + "..." + b; }

# group: WM 개수당 개체 복제 후 매칭<Wall>
count_7 = List.Count(list=code_block_27@L2)
ofRepeatedItem_7 = List.OfRepeatedItem(item=watch_room_name@L1, amount=count_7@L1)
code_block_28 = CodeBlock(a=ofRepeatedItem_7, b=code_block_27) { a + "..." + b; }

watch_10 = Watch(code_block_28)
watch_room_perimeter = Watch(code_block_10)

# group: WM 개수당 개체 복제 후 매칭<Wall>
count_8 = List.Count(list=watch_10@L2)
ofRepeatedItem_8 = List.OfRepeatedItem(item=watch_room_perimeter@L1, amount=count_8@L1)
code_block_29 = CodeBlock(b=watch_10, a=ofRepeatedItem_8) { b + "..." + a; }

watch_11 = Watch(code_block_29)

# group: WM 개수당 개체 복제 후 매칭<Skirt>
count_9 = List.Count(list=watch_wm_skirt@L2)
ofRepeatedItem_9 = List.OfRepeatedItem(item=watch_7@L1, amount=count_9@L1)
code_block_30 = CodeBlock(a=ofRepeatedItem_9, b=watch_wm_skirt) { a + "..." + b; }

# group: WM 개수당 개체 복제 후 매칭<Skirt>
count_10 = List.Count(list=code_block_30@L2)
ofRepeatedItem_10 = List.OfRepeatedItem(item=watch_department@L1, amount=count_10@L1)
code_block_31 = CodeBlock(a=ofRepeatedItem_10, b=code_block_30) { a + "..." + b; }

# group: WM 개수당 개체 복제 후 매칭<Skirt>
count_11 = List.Count(list=code_block_31@L2)
ofRepeatedItem_11 = List.OfRepeatedItem(item=watch_room_name@L1, amount=count_11@L1)
code_block_32 = CodeBlock(a=ofRepeatedItem_11, b=code_block_31) { a + "..." + b; }

watch_12 = Watch(code_block_32)

# group: WM 개수당 개체 복제 후 매칭<Wall>
count_12 = List.Count(list=watch_12@L2)
ofRepeatedItem_12 = List.OfRepeatedItem(item=watch_room_perimeter@L1, amount=count_12@L1)
code_block_33 = CodeBlock(b=watch_12, a=ofRepeatedItem_12) { b + "..." + a; }

watch_13 = Watch(code_block_33)

# group: WM 개수당 개체 복제 후 매칭<Ceiling>
count_13 = List.Count(list=watch_wm_ceiling@L2)
ofRepeatedItem_13 = List.OfRepeatedItem(item=watch_7@L1, amount=count_13@L1)
code_block_34 = CodeBlock(a=ofRepeatedItem_13, b=watch_wm_ceiling) { a + "..." + b; }

# group: WM 개수당 개체 복제 후 매칭<Ceiling>
count_14 = List.Count(list=code_block_34@L2)
ofRepeatedItem_14 = List.OfRepeatedItem(item=watch_department@L1, amount=count_14@L1)
code_block_35 = CodeBlock(a=ofRepeatedItem_14, b=code_block_34) { a + "..." + b; }

# group: WM 개수당 개체 복제 후 매칭<Ceiling>
count_15 = List.Count(list=code_block_35@L2)
ofRepeatedItem_15 = List.OfRepeatedItem(item=watch_room_name@L1, amount=count_15@L1)
code_block_36 = CodeBlock(a=ofRepeatedItem_15, b=code_block_35) { a + "..." + b; }

watch_14 = Watch(code_block_36)

# group: WM 개수당 개체 복제 후 매칭<Ceiling>
count_16 = List.Count(list=watch_14@L2)
ofRepeatedItem_16 = List.OfRepeatedItem(item=watch_room_area@L1, amount=count_16@L1)
code_block_37 = CodeBlock(b=watch_8, a=ofRepeatedItem_16) { b + "..." + a; }

watch_15 = Watch(code_block_37)
list_create_2 = List.Create(item0=watch_9, item1=watch_11, item2=watch_13, item3=watch_15)
code_block_38 = CodeBlock { "..."; }
split_2 = String.Split(str=list_create_2, separator0=code_block_38)
code_block_39 = CodeBlock { 2; }
flatten_2 = List.Flatten(list=split_2, amt=code_block_39)
code_block_40 = CodeBlock(str1=flatten_2)
# ---------- code_block_40.designscript (4 lines) ----------
t1 =
String.ToNumber(List.GetItemAtIndex(str1@L2<1>, 6))
*
String.ToNumber(List.GetItemAtIndex(str1@L2<1>, 7));
# ----------------------------------------
watch_16 = Watch(code_block_40)
addItemToEnd = List.AddItemToEnd(item=watch_16@L1, list=flatten_2@L2)
code_block_41 = CodeBlock { true; }
exportExcel = Data.ExportExcel(filePath=file_path, sheetName=code_block_20, startRow=code_block_21, startCol=code_block_21, data=addItemToEnd, overWrite=code_block_41)
