# Dynamo graph 1_Mass Arrangement (by Building List)(1123).dyn (Dynamo 2.10.1.3976)
# packages: Clockwork for Dynamo 2.x 2.3.0, Ampersand 2019.12.31

# group: Data 전처리 구간

# group: Excel Import 구간

# note: select the space planning family with the corresponding parameters to be overwritten by Dynamo
family_types = FamilyTypes("Space Planning Box_hec:Space Planning Box_hec")  # graph input
file_path = Filename(".\01_Building List_Pilot Project_2021_1123.xlsx")  # graph input
code_block = CodeBlock { "Building List"; }
python_script_import_excel_by = Python(IN[0]=file_path, IN[1]=code_block)  # "Python Script@Import Excel(By OpenpyXl)"; CPython3
# ---------- python_script_import_excel_by.python (50 lines) ----------
# Load the Python Standard and DesignScript Libraries
import sys
import os
#sys.path.append(r'C:\Users\HEC\AppData\Local\Programs\Python\Python39\Lib\site-packages')
#sys.path.append(r'C:\Users\pjmk0\AppData\Local\Programs\Python\Python39\Lib\site-packages')
sys.path.append(os.getenv('LOCALAPPDATA').replace('\\','\\\\') + r'\Programs\Python\Python39\Lib\site-packages')
import clr
clr.AddReference('ProtoGeometry')
from Autodesk.DesignScript.Geometry import *
from collections import Iterable

def iterable(obj):
    return isinstance(obj, Iterable)


# The inputs to this node will be stored as a list in the IN variables.
dataEnteringNode = IN
PathIn = IN[0]
SheetNameIn = IN[1]

# Place your code below this line
import datetime
import openpyxl

path = (PathIn)
#path = (r'C:\Users\pjmk0\Downloads\MK\mQ\BIM_물량집계 자동화 산출기준표_rC(20210607)_mk_de.xlsx')

wb_obj = openpyxl.load_workbook(path, data_only=True)
sheet_obj = wb_obj.get_sheet_by_name(SheetNameIn)

m_row = sheet_obj.max_row
m_col = sheet_obj.max_column

listOut = []



for i in range(1, m_row +1):
    listTemp = []
    for j in range(1, m_col + 1):
        cell_obj = sheet_obj.cell(row=i, column=j)
        listTemp.append(cell_obj.value)
        if len(listTemp) == m_col:
            listOut.append(listTemp)
        


# Assign your output to the OUT variable.
OUT = listOut
#OUT = os.getenv('APPDATA')
# ----------------------------------------

# group: 절대좌표 바깥쪽 불필요 데이터 제거
firstItem = List.FirstItem(list=python_script_import_excel_by)
string_from_object = FromObject(object=firstItem)
code_block_2 = CodeBlock { "null"; }
allIndicesOf = List.AllIndicesOf(list=string_from_object, item=code_block_2)
removeItemAtIndex = List.RemoveItemAtIndex(list=python_script_import_excel_by@L2, indices=allIndicesOf)

# group: 시트 헤더 분리
code_block_3 = CodeBlock { 4; }
getItemAtIndex = List.GetItemAtIndex(list=removeItemAtIndex, index=code_block_3)

# group: 시트 타이틀 및 헤더 제거
code_block_4 = CodeBlock { 1..4; }
removeItemAtIndex_2 = List.RemoveItemAtIndex(list=removeItemAtIndex, indices=code_block_4)

# group: 절대좌표와 Building Name 칼럼 추출
transpose = List.Transpose(lists=removeItemAtIndex_2)
code_block_5 = CodeBlock { "Building Name"; }
firstIndexOf = List.FirstIndexOf(list=getItemAtIndex, item=code_block_5)
code_block_6 = CodeBlock(i=firstIndexOf)
# ---------- code_block_6.designscript (3 lines) ----------
[0,i];
//index[0]은 절대좌표
//index[i]은 Building Name
# ----------------------------------------
getItemAtIndex_2 = List.GetItemAtIndex(list=transpose, index=code_block_6)

# group: 건물별 분리기준 행 추출
string_from_object_2 = FromObject(object=getItemAtIndex_2)
lastItem = List.LastItem(list=string_from_object_2)

# group: 건물별 분리
code_block_7 = CodeBlock { 0; "null"; }
replaceItemAtIndex = List.ReplaceItemAtIndex(list=lastItem, index=code_block_7.out0, item=code_block_7.out1)
code_block_8 = CodeBlock(i=replaceItemAtIndex) { i != "null"; true; }
allIndicesOf_2 = List.AllIndicesOf(list=code_block_8.out0, item=code_block_8.out1)
전체_데이터_by_row = CodeBlock(i=transpose) { i; }
절대좌표_by_row = CodeBlock(i=전체_데이터_by_row) { i[0]; }
count = List.Count(list=절대좌표_by_row)
join = List.Join(list0=allIndicesOf_2, list1=count)
index_finder_건물별_row = Python(IN[0]=join)  # CPython3
# ---------- index_finder_건물별_row.python (22 lines) ----------
# Load the Python Standard and DesignScript Libraries
import sys
import clr
clr.AddReference('ProtoGeometry')
from Autodesk.DesignScript.Geometry import *

# The inputs to this node will be stored as a list in the IN variables.
dataEnteringNode = IN

inputIndex = IN[0]
# Place your code below this line
result = []

for i in range(len(inputIndex)):
    if i+1 < len(inputIndex):
        result.append(range(inputIndex[i], inputIndex[i+1]))
    else:
        pass


# Assign your output to the OUT variable.
OUT = result
# ----------------------------------------
getItemAtIndex_3 = List.GetItemAtIndex(list=transpose@L2, index=index_finder_건물별_row@L2, lacing=CrossProduct)
transpose_2 = List.Transpose(lists=getItemAtIndex_3)

# group: 건물선택
건물별_그룹데이터_by_column = CodeBlock(i=transpose_2) { i; }
code_block_9 = CodeBlock { 3; }
getItemAtIndex_4 = List.GetItemAtIndex(list=건물별_그룹데이터_by_column@L3, index=code_block_9)
firstItem_2 = List.FirstItem(list=getItemAtIndex_4@L2)
건물선택 = StringInput("CCB")
contains = String.Contains(str=firstItem_2, searchFor=건물선택)
code_block_10 = CodeBlock { true; }
firstIndexOf_2 = List.FirstIndexOf(list=contains, item=code_block_10)
getItemAtIndex_5 = List.GetItemAtIndex(list=건물별_그룹데이터_by_column, index=firstIndexOf_2)

# group: 불필요 Row 제거
시트_헤더 = CodeBlock(i=getItemAtIndex) { i; }
string_from_object_3 = FromObject(object=시트_헤더)
code_block_11 = CodeBlock { "Room Name"; }
contains_2 = String.Contains(str=string_from_object_3, searchFor=code_block_11)
code_block_12 = CodeBlock { true; }
firstIndexOf_3 = List.FirstIndexOf(list=contains_2, item=code_block_12)
getItemAtIndex_6 = List.GetItemAtIndex(list=getItemAtIndex_5, index=firstIndexOf_3)
string_from_object_4 = FromObject(object=getItemAtIndex_6)
code_block_13 = CodeBlock(i=string_from_object_4) { i=="null"?false:true; true; }
allIndicesOf_3 = List.AllIndicesOf(list=code_block_13.out0, item=code_block_13.out1)
getItemAtIndex_7 = List.GetItemAtIndex(list=getItemAtIndex_5@L2, index=allIndicesOf_3)

# group: header별 데이터 딕셔너리 형성
시트_헤더_2 = CodeBlock(i=getItemAtIndex) { i; }
code_block_14 = CodeBlock { 1; }
list_dropitems_절대좌표제거 = List.DropItems(list=시트_헤더_2, amount=code_block_14)
string_from_object_5 = FromObject(object=list_dropitems_절대좌표제거)
code_block_15 = CodeBlock { 1; }
list_dropitems_절대좌표제거_2 = List.DropItems(list=getItemAtIndex_7, amount=code_block_15)
python_script = Python(IN[0]=string_from_object_5, IN[1]=list_dropitems_절대좌표제거_2)  # CPython3
# ---------- python_script.python (22 lines) ----------
# Load the Python Standard and DesignScript Libraries
import sys
import clr
clr.AddReference('ProtoGeometry')
from Autodesk.DesignScript.Geometry import *

# The inputs to this node will be stored as a list in the IN variables.
dataEnteringNode = IN

inputKeys = IN[0]
inputValues = IN[1]

# Place your code below this line

dict = {}
for i in range(len(inputKeys)):
    dict[inputKeys[i]] = inputValues[i]
    
result = dict

# Assign your output to the OUT variable.
OUT = result
# ----------------------------------------

code_block_16 = CodeBlock(header=string_from_object_5, data=python_script, data_nondic=list_dropitems_절대좌표제거_2)
# ---------- code_block_16.designscript (5 lines) ----------
{
"header": _header,
"data": _data,
"data_nondic": _data_nondic
};
# ----------------------------------------

# group: 속성별 데이터 분류
code_block_17 = CodeBlock(input=code_block_16) { input; }
code_block_18 = CodeBlock(i=code_block_17) { i["data"]; }
code_block_19 = CodeBlock(i=code_block_17) { i["header"]; }
integer_slider = IntegerSlider(9, range=0..70 step 1)
code_block_20 = CodeBlock(i=code_block_19, j=integer_slider) { i[j]; }
watch = Watch(code_block_20)
valueAtKey = DesignScript.Builtin.Dictionary.ValueAtKey(dictionary=code_block_18, key=watch)

# group: Multiplying instances of WIDTH by the QUANTITY column from spreadsheet
code_block_21 = CodeBlock(i=valueAtKey) { i*1000; }
# note: multiplies each Department
# by the associated value in the
# QUANTITY column from the
# Excel file
count_2 = List.Count(list=code_block_21@L1)
ofRepeatedItem = List.OfRepeatedItem(item=code_block_21@L1, amount=count_2@L1)
# note: consolidate all sublist
# groups into one seamless list
flatten = List.Flatten(list=ofRepeatedItem)

# group: 속성별 데이터 분류
code_block_22 = CodeBlock(input=code_block_16) { input; }
code_block_23 = CodeBlock(i=code_block_22) { i["data"]; }
code_block_24 = CodeBlock(i=code_block_22) { i["header"]; }
integer_slider_2 = IntegerSlider(6, range=0..70 step 1)
code_block_25 = CodeBlock(i=code_block_24, j=integer_slider_2) { i[j]; }
watch_2 = Watch(code_block_25)
valueAtKey_2 = DesignScript.Builtin.Dictionary.ValueAtKey(dictionary=code_block_23, key=watch_2)

# group: SORTING: This sequence of creates a new list of sequential unique index number to later be paired with all Department values from the Excel spreadsheet
code_block_26 = CodeBlock { 0; }
# note: flips data to be grouped
# by column not row
# note: select 'Floor'
count_3 = List.Count(list=valueAtKey_2@L1)

# group: Accounting for QUANTITY column from spreadsheet
# note: multiplies each Department
# by the associated value in the
# QUANTITY column from the
# Excel file
ofRepeatedItem_2 = List.OfRepeatedItem(item=valueAtKey_2@L1, amount=count_3@L1)
# note: consolidate all sublist
# groups into one seamless list
flatten_2 = List.Flatten(list=ofRepeatedItem_2)

# group (continued): SORTING: This sequence of creates a new list of sequential unique index number to later be paired with all Department values from the Excel spreadsheet
countOccurences = Custom[List.CountOccurences](seq=flatten_2)  # package Clockwork for Dynamo 2.x; Counts the number of occurences of each unique element in a given list
python_script_2 = Python(IN[0]=countOccurences.count)  # IronPython2
# ---------- python_script_2.python (22 lines) ----------
# Load the Python Standard and DesignScript Libraries
import sys
import clr
clr.AddReference('ProtoGeometry')
from Autodesk.DesignScript.Geometry import *

# The inputs to this node will be stored as a list in the IN variables.
dataEnteringNode = IN
inList = IN[0]
outList = []

# Place your code below this line
acc = 0
for i in inList:
	acc = acc + i
	outList.append(acc)
	



# Assign your output to the OUT variable.
OUT = outList
# ----------------------------------------
addItemToFront = List.AddItemToFront(item=code_block_26, list=python_script_2)
# note: Assigns a unique number
#  to each Department
# occurence
# note: Since 0 is included as an index,
# need to reduce the list by 1 to
# maintain the actual number of
# items
# note: From LunchBox package:
# Recursive Function -
# adds each item in the list
# to the sum of the values
# before it until the list is
# exhausted.
# note: Adds 0 to the front
# of the list so every
# count starts at 0
# note: From Clockwork package:
# Counts number of times each
# unique item (department) occurs.
# Output:
# 1. list of unique items
# 2. number of occurences
code_block_27 = CodeBlock(x=python_script_2) { x-1; }
code_block_28 = CodeBlock(x=addItemToFront, y=code_block_27) { x..y; }

# note: regroups the Width values
# by Department count
getItemAtIndex_8 = List.GetItemAtIndex(list=flatten, index=code_block_28)
integer_slider_3 = IntegerSlider(20000, range=0..20000 step 5)
code_block_29 = CodeBlock(SPACER=integer_slider_3) { SPACER; }

# group: 속성별 데이터 분류
code_block_30 = CodeBlock(input=code_block_16) { input; }
code_block_31 = CodeBlock(i=code_block_30) { i["data"]; }
code_block_32 = CodeBlock(i=code_block_30) { i["header"]; }
integer_slider_4 = IntegerSlider(10, range=0..70 step 1)
code_block_33 = CodeBlock(i=code_block_32, j=integer_slider_4) { i[j]; }
watch_3 = Watch(code_block_33)
valueAtKey_3 = DesignScript.Builtin.Dictionary.ValueAtKey(dictionary=code_block_31, key=watch_3)

# group: Multiplying instances of LENGTH by the QUANTITY column from spreadsheet
code_block_34 = CodeBlock(i=valueAtKey_3) { i*1000; }
# note: multiplies each Department
# by the associated value in the
# QUANTITY column from the
# Excel file
count_4 = List.Count(list=code_block_34@L1)
ofRepeatedItem_3 = List.OfRepeatedItem(item=code_block_34@L1, amount=count_4@L1)
# note: consolidate all sublist
# groups into one seamless list
flatten_3 = List.Flatten(list=ofRepeatedItem_3)

# note: regroups the Length values
# by Department count
getItemAtIndex_9 = List.GetItemAtIndex(list=flatten_3, index=code_block_28)

# group: SPACING: Using Recursive function to evenly space centroid coordinates based on program widths from spreadsheet.
code_block_35 = CodeBlock(list=getItemAtIndex_8) { list; }
code_block_36 = CodeBlock(a=code_block_35) { a/2; }
code_block_37 = CodeBlock { 1; }
shiftIndices = List.ShiftIndices(list=code_block_36@L2, amount=code_block_37)
code_block_38 = CodeBlock(x=shiftIndices) { x; }
code_block_39 = CodeBlock { 0; }
replaceItemAtIndex_2 = List.ReplaceItemAtIndex(list=code_block_38@L2, index=code_block_39, item=code_block_39)
count_5 = List.Count(list=code_block_35@L2)
code_block_40 = CodeBlock(n=count_5) { n-1; }
ofRepeatedItem_4 = List.OfRepeatedItem(item=code_block_29, amount=code_block_40)
code_block_41 = CodeBlock { 0; }
insert = List.Insert(list=ofRepeatedItem_4@L2, element=code_block_41, index=code_block_41)
code_block_42 = CodeBlock(a=code_block_36, b=replaceItemAtIndex_2, c=insert) { [a,b,c]; }
transpose_3 = List.Transpose(lists=code_block_42)
transpose_4 = List.Transpose(lists=transpose_3@L3)
sum = Math.Sum(values=transpose_4)
maximumItem = List.MaximumItem(list=getItemAtIndex_9)
code_block_43 = CodeBlock(a=maximumItem) { [a/2]; }
flatten_4 = List.Flatten(list=code_block_43)
code_block_44 = CodeBlock { 1; }
shiftIndices_2 = List.ShiftIndices(list=flatten_4, amount=code_block_44)
code_block_45 = CodeBlock { 0; }
replaceItemAtIndex_3 = List.ReplaceItemAtIndex(list=shiftIndices_2, index=code_block_45, item=code_block_45)
# note: Collect the largest Length value
# note: cut all Width values in half
# note: "helper node":
# re-positioning for
# cleaning up canvas
count_6 = List.Count(list=maximumItem)
# note: cut all Length values in half
# note: Since 0 is included as an index,
# need to reduce the list by 1 to
# maintain the actual number of
# items
# note: count the number of
# items in every sublist
# note: rotate all values in list
# by one position...
# end comes front,
# everything else moves
# down one index
# note: consolidate all sublist
# groups into one seamless list
code_block_46 = CodeBlock(n=count_6) { n-1; }
ofRepeatedItem_5 = List.OfRepeatedItem(item=code_block_29, amount=code_block_46)
# note: replace the first item in
# each sublist with 0 so the
# spacing occurs after the
# first instance
# note: pair the three lists together:
# 1. half the width values from the first item
# 2. half the width values from the next item
# 3. the space value between points
# note: these Transpose functions re-sort the sublist so that the values are grouped by individual width values for each point
# note: sum each with sublist
# to get total point distance
# note: From LunchBox package:
# Recursive Function -
# adds each item in the list
# to the sum of the values
# before it until the list is
# exhausted...
# Spaces each point along the X Axis
# note: replace with 0 as
# starting position for
# the first point
# note: pair the three lists together:
# 1. half the length values from the first item
# 2. half the length values from the next item
# 3. the space value between points
# note: this Transpose function re-sorts the sublist so that the values are grouped by individual width values for each point
# note: buffer: two mapped nodes
# in a row made the second
# function replace an additional
# index... this fixes glitch
# note: copy the spacer value
# as many times as the
# number of items in
# every sublist
# note: replace the first item in
# each sublist with 0 as
# starting position for the
# first point
code_block_47 = CodeBlock { 0; }
insert_2 = List.Insert(list=ofRepeatedItem_5, element=code_block_47, index=code_block_47)
code_block_48 = CodeBlock(a=flatten_4, b=replaceItemAtIndex_3, c=insert_2) { [a,b,c]; }
transpose_5 = List.Transpose(lists=code_block_48)
sum_2 = Math.Sum(values=transpose_5)

python_script_3 = Python(IN[0]=sum)  # IronPython2
# ---------- python_script_3.python (27 lines) ----------
# Load the Python Standard and DesignScript Libraries
import sys
import clr
clr.AddReference('ProtoGeometry')
from Autodesk.DesignScript.Geometry import *

# The inputs to this node will be stored as a list in the IN variables.
dataEnteringNode = IN
inList = IN[0]
outList = []

# Place your code below this line


for i in inList:
	acc = 0
	for j in i:
		acc = acc + j
		outList.append(acc)
#	for j in i:
#		acc = acc + j
#		outList.append([acc])



# Assign your output to the OUT variable.
OUT = outList
# ----------------------------------------
count_7 = List.Count(list=sum@L2)
chop = List.Chop(list=python_script_3, lengths=count_7)
python_script_4 = Python(IN[0]=sum_2)  # IronPython2; same code as python_script_2
element_types = ElementTypes("Level")
all_elements_of_type = ElementsOfType(element_type=element_types)
count_8 = List.Count(list=chop@L2)
ofRepeatedItem_6 = List.OfRepeatedItem(item=all_elements_of_type, amount=count_8, lacing=Longest)

# group: INSTANTIATION: Placing Space Planning family at centroid coordinates.
byCoordinates = Point.ByCoordinates(x=chop)
# note: Create points according to the
# calculated Width values along
# the X Axis...
# Locate the points along the
# Y Axis according to the calculated
# Length values
byCoordinates_2 = Vector.ByCoordinates(y=python_script_4)
add = Point.Add(point=byCoordinates@L2, vectorToAdd=byCoordinates_2@L1)
# note: places an instance of the family
# at each point location
byPointAndLevel = FamilyInstance.ByPointAndLevel(familyType=family_types, point=add, level=ofRepeatedItem_6)

# group: 층별 갯수 계산
code_block_49 = CodeBlock { "countByFloor"; }
code_block_50 = CodeBlock(input=code_block_16) { input; }
components = DesignScript.Builtin.Dictionary.Components(dictionary=code_block_50)
addItemToEnd = List.AddItemToEnd(item=code_block_49, list=components.keys)
code_block_51 = CodeBlock(i=code_block_50) { i["data"]; }
code_block_52 = CodeBlock(i=code_block_50) { i["header"]; }
integer_slider_5 = IntegerSlider(6, range=0..70 step 1)
code_block_53 = CodeBlock(i=code_block_52, j=integer_slider_5) { i[j]; }
watch_4 = Watch(code_block_53)
valueAtKey_4 = DesignScript.Builtin.Dictionary.ValueAtKey(dictionary=code_block_51, key=watch_4)
층별_갯수_계산 = CodeBlock(i=valueAtKey_4) { j = List.UniqueItems(i); blnlist = i==j<1>; List.CountTrue(blnlist<1>); }
addItemToEnd_2 = List.AddItemToEnd(item=층별_갯수_계산.out2, list=components.values)
byKeysValues = DesignScript.Builtin.Dictionary.ByKeysValues(keys=addItemToEnd, values=addItemToEnd_2)

# group: 속성별 데이터 분류-by Grouped as Floor
code_block_54 = CodeBlock(input=byKeysValues) { input; }
code_block_55 = CodeBlock(i=code_block_54) { i["data"]; }
code_block_56 = CodeBlock(i=code_block_54) { i["header"]; }
integer_slider_6 = IntegerSlider(9, range=0..70 step 1)
code_block_57 = CodeBlock(i=code_block_56, j=integer_slider_6) { i[j]; }
watch_5 = Watch(code_block_57)
valueAtKey_5 = DesignScript.Builtin.Dictionary.ValueAtKey(dictionary=code_block_55, key=watch_5)
code_block_58 = CodeBlock(i=code_block_54) { i["countByFloor"]; }
chop_2 = List.Chop(list=valueAtKey_5, lengths=code_block_58)
length = CodeBlock(result=chop_2) { result*1000; }

# group: 속성별 데이터 분류-by Grouped as Floor
code_block_59 = CodeBlock(input=byKeysValues) { input; }
code_block_60 = CodeBlock(i=code_block_59) { i["data"]; }
code_block_61 = CodeBlock(i=code_block_59) { i["header"]; }
integer_slider_7 = IntegerSlider(10, range=0..70 step 1)
code_block_62 = CodeBlock(i=code_block_61, j=integer_slider_7) { i[j]; }
watch_6 = Watch(code_block_62)
valueAtKey_6 = DesignScript.Builtin.Dictionary.ValueAtKey(dictionary=code_block_60, key=watch_6)
code_block_63 = CodeBlock(i=code_block_59) { i["countByFloor"]; }
chop_3 = List.Chop(list=valueAtKey_6, lengths=code_block_63)
length_2 = CodeBlock(result=chop_3) { result*1000; }

# group: 속성별 데이터 분류-by Grouped as Floor
code_block_64 = CodeBlock(input=byKeysValues) { input; }
code_block_65 = CodeBlock(i=code_block_64) { i["data"]; }
code_block_66 = CodeBlock(i=code_block_64) { i["header"]; }
integer_slider_8 = IntegerSlider(14, range=0..70 step 1)
code_block_67 = CodeBlock(i=code_block_66, j=integer_slider_8) { i[j]; }
watch_7 = Watch(code_block_67)
valueAtKey_7 = DesignScript.Builtin.Dictionary.ValueAtKey(dictionary=code_block_65, key=watch_7)
code_block_68 = CodeBlock(i=code_block_64) { i["countByFloor"]; }
chop_4 = List.Chop(list=valueAtKey_7, lengths=code_block_68)
area = CodeBlock(result=chop_4) { result; }

# group: 속성별 데이터 분류-by Grouped as Floor
code_block_69 = CodeBlock(input=byKeysValues) { input; }
code_block_70 = CodeBlock(i=code_block_69) { i["data"]; }
code_block_71 = CodeBlock(i=code_block_69) { i["header"]; }
integer_slider_9 = IntegerSlider(11, range=0..70 step 1)
code_block_72 = CodeBlock(i=code_block_71, j=integer_slider_9) { i[j]; }
watch_8 = Watch(code_block_72)
valueAtKey_8 = DesignScript.Builtin.Dictionary.ValueAtKey(dictionary=code_block_70, key=watch_8)
code_block_73 = CodeBlock(i=code_block_69) { i["countByFloor"]; }
chop_5 = List.Chop(list=valueAtKey_8, lengths=code_block_73)
height = CodeBlock(result=chop_5) { result*1000; }

# group: 속성별 데이터 분류-by Grouped as Floor
code_block_74 = CodeBlock(input=byKeysValues) { input; }
code_block_75 = CodeBlock(i=code_block_74) { i["data"]; }
code_block_76 = CodeBlock(i=code_block_74) { i["header"]; }
integer_slider_10 = IntegerSlider(65, range=0..70 step 1)
code_block_77 = CodeBlock(i=code_block_76, j=integer_slider_10) { i[j]; }
watch_9 = Watch(code_block_77)
valueAtKey_9 = DesignScript.Builtin.Dictionary.ValueAtKey(dictionary=code_block_75, key=watch_9)
code_block_78 = CodeBlock(i=code_block_74) { i["countByFloor"]; }
chop_6 = List.Chop(list=valueAtKey_9, lengths=code_block_78)
dicipline = CodeBlock(result=chop_6) { result; }

# group: SORTING: Re-sorting all categories from the spreadsheet into sublists according to unique Departments
# note: From the Clockwork package:
# count all unique Departments
# note: select only items in index 1
# (DEPARTMENT column)
# note: From Ampersand package:
# resort each column by the
# number of items in each
# unique Department
code_block_79 = CodeBlock(i=list_dropitems_절대좌표제거_2) { i; }
code_block_80 = CodeBlock(i=valueAtKey_2) { i; }
countOccurences_2 = Custom[List.CountOccurences](seq=code_block_80)
list_chopbylengths = Custom[[&] List.ChopByLengths](list=code_block_79@L2, lengths=countOccurences_2.count)  # package Ampersand; Chop a list into sublists given a series of sizes. Remaining list items after the sublists have been filled are discarded. Remaining sublist capacity after list items are exhausted is ignored.

code_block_81 = CodeBlock(x=list_chopbylengths) { x; }  # frozen

# group: 속성별 데이터 분류-by Grouped as Floor @ Int. Wall Finish
code_block_82 = CodeBlock { ".."; }
code_block_83 = CodeBlock(input=byKeysValues) { input; }
code_block_84 = CodeBlock(i=code_block_83) { i["data_nondic"]; }
code_block_85 = CodeBlock(i=code_block_83) { i["header"]; }
code_block_86 = CodeBlock { "Int."; }
contains_3 = String.Contains(str=code_block_85, searchFor=code_block_86)
code_block_87 = CodeBlock { true; }
allIndicesOf_4 = List.AllIndicesOf(list=contains_3, item=code_block_87)
getItemAtIndex_10 = List.GetItemAtIndex(list=code_block_84, index=allIndicesOf_4)
getItemAtIndex_11 = List.GetItemAtIndex(list=code_block_85, index=allIndicesOf_4)
code_block_88 = CodeBlock { "Wall"; }
contains_4 = String.Contains(str=getItemAtIndex_11, searchFor=code_block_88)
code_block_89 = CodeBlock { true; }
allIndicesOf_5 = List.AllIndicesOf(list=contains_4, item=code_block_89)
getItemAtIndex_12 = List.GetItemAtIndex(list=getItemAtIndex_10, index=allIndicesOf_5)
transpose_6 = List.Transpose(lists=getItemAtIndex_12)
join_2 = String.Join(separator=code_block_82, string0=transpose_6@L2)
code_block_90 = CodeBlock { "N/A"; }
isNull = Object.IsNull()  # unwired: object
replaceByCondition = Replace(item=getItemAtIndex_12, replaceWith=code_block_90, condition=isNull)

# group: string 검사
code_block_91 = CodeBlock(input=join_2) { input; }
code_block_92 = CodeBlock { ".."; }
endsWith = String.EndsWith(str=code_block_91, searchFor=code_block_92)
code_block_93 = CodeBlock { -1; }
code_block_94 = CodeBlock { -2; }
remove = String.Remove(string=code_block_91, startIndex=code_block_93, count=code_block_94)
if_ = If(test=endsWith, true=remove, false=code_block_91)

# group: 속성별 데이터 분류-by Grouped as Floor @ Int. Base Finish
code_block_95 = CodeBlock { ".."; }
code_block_96 = CodeBlock(input=byKeysValues) { input; }
code_block_97 = CodeBlock(i=code_block_96) { i["data_nondic"]; }
code_block_98 = CodeBlock(i=code_block_96) { i["header"]; }
code_block_99 = CodeBlock { "Int."; }
contains_5 = String.Contains(str=code_block_98, searchFor=code_block_99)
code_block_100 = CodeBlock { true; }
allIndicesOf_6 = List.AllIndicesOf(list=contains_5, item=code_block_100)
getItemAtIndex_13 = List.GetItemAtIndex(list=code_block_97, index=allIndicesOf_6)
getItemAtIndex_14 = List.GetItemAtIndex(list=code_block_98, index=allIndicesOf_6)
code_block_101 = CodeBlock { "Base"; }
contains_6 = String.Contains(str=getItemAtIndex_14, searchFor=code_block_101)
code_block_102 = CodeBlock { true; }
allIndicesOf_7 = List.AllIndicesOf(list=contains_6, item=code_block_102)
getItemAtIndex_15 = List.GetItemAtIndex(list=getItemAtIndex_13, index=allIndicesOf_7)
transpose_7 = List.Transpose(lists=getItemAtIndex_15)
join_3 = String.Join(separator=code_block_95, string0=transpose_7@L2)
code_block_103 = CodeBlock { "N/A"; }
isNull_2 = Object.IsNull()  # unwired: object
replaceByCondition_2 = Replace(item=getItemAtIndex_15, replaceWith=code_block_103, condition=isNull_2)

# group: string 검사
code_block_104 = CodeBlock(input=join_3) { input; }
code_block_105 = CodeBlock { ".."; }
endsWith_2 = String.EndsWith(str=code_block_104, searchFor=code_block_105)
code_block_106 = CodeBlock { -1; }
code_block_107 = CodeBlock { -2; }
remove_2 = String.Remove(string=code_block_104, startIndex=code_block_106, count=code_block_107)
if_2 = If(test=endsWith_2, true=remove_2, false=code_block_104)

# group: 속성별 데이터 분류-by Grouped as Floor @ Int. Floor Finish
code_block_108 = CodeBlock { ".."; }
code_block_109 = CodeBlock(input=byKeysValues) { input; }
code_block_110 = CodeBlock(i=code_block_109) { i["data_nondic"]; }
code_block_111 = CodeBlock(i=code_block_109) { i["header"]; }
code_block_112 = CodeBlock { "Int."; }
contains_7 = String.Contains(str=code_block_111, searchFor=code_block_112)
code_block_113 = CodeBlock { true; }
allIndicesOf_8 = List.AllIndicesOf(list=contains_7, item=code_block_113)
getItemAtIndex_16 = List.GetItemAtIndex(list=code_block_110, index=allIndicesOf_8)
getItemAtIndex_17 = List.GetItemAtIndex(list=code_block_111, index=allIndicesOf_8)
code_block_114 = CodeBlock { "Floor"; }
contains_8 = String.Contains(str=getItemAtIndex_17, searchFor=code_block_114)
code_block_115 = CodeBlock { true; }
allIndicesOf_9 = List.AllIndicesOf(list=contains_8, item=code_block_115)
getItemAtIndex_18 = List.GetItemAtIndex(list=getItemAtIndex_16, index=allIndicesOf_9)
transpose_8 = List.Transpose(lists=getItemAtIndex_18)
join_4 = String.Join(separator=code_block_108, string0=transpose_8@L2)
code_block_116 = CodeBlock { "N/A"; }
isNull_3 = Object.IsNull()  # unwired: object
replaceByCondition_3 = Replace(item=getItemAtIndex_18, replaceWith=code_block_116, condition=isNull_3)

# group: string 검사
code_block_117 = CodeBlock(input=join_4) { input; }
code_block_118 = CodeBlock { ".."; }
endsWith_3 = String.EndsWith(str=code_block_117, searchFor=code_block_118)
code_block_119 = CodeBlock { -1; }
code_block_120 = CodeBlock { -2; }
remove_3 = String.Remove(string=code_block_117, startIndex=code_block_119, count=code_block_120)
if_3 = If(test=endsWith_3, true=remove_3, false=code_block_117)

# group: 속성별 데이터 분류-by Grouped as Floor @ Int. Ceiling Finish
code_block_121 = CodeBlock { ".."; }
code_block_122 = CodeBlock(input=byKeysValues) { input; }
code_block_123 = CodeBlock(i=code_block_122) { i["data_nondic"]; }
code_block_124 = CodeBlock(i=code_block_122) { i["header"]; }
code_block_125 = CodeBlock { "Int."; }
contains_9 = String.Contains(str=code_block_124, searchFor=code_block_125)
code_block_126 = CodeBlock { true; }
allIndicesOf_10 = List.AllIndicesOf(list=contains_9, item=code_block_126)
getItemAtIndex_19 = List.GetItemAtIndex(list=code_block_123, index=allIndicesOf_10)
getItemAtIndex_20 = List.GetItemAtIndex(list=code_block_124, index=allIndicesOf_10)
code_block_127 = CodeBlock { "Ceiling"; }
contains_10 = String.Contains(str=getItemAtIndex_20, searchFor=code_block_127)
code_block_128 = CodeBlock { true; }
allIndicesOf_11 = List.AllIndicesOf(list=contains_10, item=code_block_128)
getItemAtIndex_21 = List.GetItemAtIndex(list=getItemAtIndex_19, index=allIndicesOf_11)
transpose_9 = List.Transpose(lists=getItemAtIndex_21)
join_5 = String.Join(separator=code_block_121, string0=transpose_9@L2)
code_block_129 = CodeBlock { "N/A"; }
isNull_4 = Object.IsNull()  # unwired: object
replaceByCondition_4 = Replace(item=getItemAtIndex_21, replaceWith=code_block_129, condition=isNull_4)

# group: string 검사
code_block_130 = CodeBlock(input=join_5) { input; }
code_block_131 = CodeBlock { ".."; }
endsWith_4 = String.EndsWith(str=code_block_130, searchFor=code_block_131)
code_block_132 = CodeBlock { -1; }
code_block_133 = CodeBlock { -2; }
remove_4 = String.Remove(string=code_block_130, startIndex=code_block_132, count=code_block_133)
if_4 = If(test=endsWith_4, true=remove_4, false=code_block_130)

code_block_134 = CodeBlock(i=code_block_83) { i["countByFloor"]; }

# group: 속성별 데이터 분류-by Grouped as Floor @ Int. Finish
code_block_135 = CodeBlock { ",,"; }
list_create = List.Create(item0=if_, item1=if_2, item2=if_3, item3=if_4)
transpose_10 = List.Transpose(lists=list_create)
join_6 = String.Join(separator=code_block_135, string0=transpose_10)
flatten_5 = List.Flatten(list=join_6)
chop_7 = List.Chop(list=flatten_5, lengths=code_block_134)

# group: 속성별 데이터 분류-by Grouped as Floor @ Roof. Finish
code_block_136 = CodeBlock { ".."; }
code_block_137 = CodeBlock(input=byKeysValues) { input; }
code_block_138 = CodeBlock(i=code_block_137) { i["data_nondic"]; }
code_block_139 = CodeBlock(i=code_block_137) { i["header"]; }
code_block_140 = CodeBlock { "Roof."; }
contains_11 = String.Contains(str=code_block_139, searchFor=code_block_140)
code_block_141 = CodeBlock { true; }
allIndicesOf_12 = List.AllIndicesOf(list=contains_11, item=code_block_141)
getItemAtIndex_22 = List.GetItemAtIndex(list=code_block_138, index=allIndicesOf_12)
transpose_11 = List.Transpose(lists=getItemAtIndex_22)
join_7 = String.Join(separator=code_block_136, string0=transpose_11@L2)
code_block_142 = CodeBlock { "N/A"; }
isNull_5 = Object.IsNull()  # unwired: object
replaceByCondition_5 = Replace(item=getItemAtIndex_22, replaceWith=code_block_142, condition=isNull_5)

# group: string 검사
code_block_143 = CodeBlock(input=join_7) { input; }
code_block_144 = CodeBlock { ".."; }
endsWith_5 = String.EndsWith(str=code_block_143, searchFor=code_block_144)
code_block_145 = CodeBlock { -1; }
code_block_146 = CodeBlock { -2; }
remove_5 = String.Remove(string=code_block_143, startIndex=code_block_145, count=code_block_146)
if_5 = If(test=endsWith_5, true=remove_5, false=code_block_143)

# group: 속성별 데이터 분류-by Grouped as Floor @ Ext. Finish
code_block_147 = CodeBlock { ".."; }
code_block_148 = CodeBlock(input=byKeysValues) { input; }
code_block_149 = CodeBlock(i=code_block_148) { i["data_nondic"]; }
code_block_150 = CodeBlock(i=code_block_148) { i["header"]; }
code_block_151 = CodeBlock { "Ext."; }
contains_12 = String.Contains(str=code_block_150, searchFor=code_block_151)
code_block_152 = CodeBlock { true; }
allIndicesOf_13 = List.AllIndicesOf(list=contains_12, item=code_block_152)
getItemAtIndex_23 = List.GetItemAtIndex(list=code_block_149, index=allIndicesOf_13)
transpose_12 = List.Transpose(lists=getItemAtIndex_23)
join_8 = String.Join(separator=code_block_147, string0=transpose_12@L2)
code_block_153 = CodeBlock { "N/A"; }
isNull_6 = Object.IsNull()  # unwired: object
replaceByCondition_6 = Replace(item=getItemAtIndex_23, replaceWith=code_block_153, condition=isNull_6)

# group: string 검사
code_block_154 = CodeBlock(input=join_8) { input; }
code_block_155 = CodeBlock { ".."; }
endsWith_6 = String.EndsWith(str=code_block_154, searchFor=code_block_155)
code_block_156 = CodeBlock { -1; }
code_block_157 = CodeBlock { -2; }
remove_6 = String.Remove(string=code_block_154, startIndex=code_block_156, count=code_block_157)
if_6 = If(test=endsWith_6, true=remove_6, false=code_block_154)

code_block_158 = CodeBlock(i=code_block_137) { i["countByFloor"]; }

# group: 속성별 데이터 분류-by Grouped as Floor @ Ext. Finish
code_block_159 = CodeBlock { ",,"; }
list_create_2 = List.Create(item0=if_5, item1=if_6)
transpose_13 = List.Transpose(lists=list_create_2)
join_9 = String.Join(separator=code_block_159, string0=transpose_13)
flatten_6 = List.Flatten(list=join_9)
chop_8 = List.Chop(list=flatten_6, lengths=code_block_158)

# group: 속성별 데이터 분류-by Grouped as Floor
code_block_160 = CodeBlock(input=byKeysValues) { input; }
code_block_161 = CodeBlock(i=code_block_160) { i["data"]; }
code_block_162 = CodeBlock(i=code_block_160) { i["header"]; }
integer_slider_11 = IntegerSlider(64, range=0..70 step 1)
code_block_163 = CodeBlock(i=code_block_162, j=integer_slider_11) { i[j]; }
watch_10 = Watch(code_block_163)
valueAtKey_10 = DesignScript.Builtin.Dictionary.ValueAtKey(dictionary=code_block_161, key=watch_10)
code_block_164 = CodeBlock(i=code_block_160) { i["countByFloor"]; }
chop_9 = List.Chop(list=valueAtKey_10, lengths=code_block_164)
dicipline_2 = CodeBlock(result=chop_9) { result; }

# group: 속성별 데이터 분류-by Grouped as Floor
code_block_165 = CodeBlock(input=byKeysValues) { input; }
code_block_166 = CodeBlock(i=code_block_165) { i["data"]; }
code_block_167 = CodeBlock(i=code_block_165) { i["header"]; }
integer_slider_12 = IntegerSlider(8, range=0..70 step 1)
code_block_168 = CodeBlock(i=code_block_167, j=integer_slider_12) { i[j]; }
watch_11 = Watch(code_block_168)
valueAtKey_11 = DesignScript.Builtin.Dictionary.ValueAtKey(dictionary=code_block_166, key=watch_11)
code_block_169 = CodeBlock(i=code_block_165) { i["countByFloor"]; }
chop_10 = List.Chop(list=valueAtKey_11, lengths=code_block_169)
room_name = CodeBlock(result=chop_10) { result; }

# group: PARAMETERS & COLOR: Setting the parameter values in the space planning families. Changing color of each family instance by associated Department.
code_block_170 = CodeBlock { "Width"; }
setParameterByName = Element.SetParameterByName(element=byPointAndLevel, parameterName=code_block_170, value=length)
code_block_171 = CodeBlock { "Length"; }
setParameterByName_2 = Element.SetParameterByName(element=byPointAndLevel, parameterName=code_block_171, value=length_2)
code_block_172 = CodeBlock { "Program Area"; }
setParameterByName_3 = Element.SetParameterByName(element=byPointAndLevel, parameterName=code_block_172, value=area)
code_block_173 = CodeBlock { "Height"; }
setParameterByName_4 = Element.SetParameterByName(element=byPointAndLevel, parameterName=code_block_173, value=height)
flatten_7 = List.Flatten(list=byPointAndLevel)
code_block_174 = CodeBlock { "Fill Color"; }
number = DoubleInput(8)  # graph input
list_getitematindex_fill_color = List.GetItemAtIndex(list=dicipline, index=number)
# note: This list assigns a name to the RGB
# color values in the Code Block below.
# These color names also correspond to
# the colors from the COLOR column in
# the Excel spreadsheet.
code_block_175 = CodeBlock { "Gray"; "Pink"; "Magenta"; "Purple"; "Lavender"; "Blue"; "Cyan"; "Teal"; "Green"; "Lime"; "Yellow"; "Orange"; "Red"; }
create = List.Create(item0=code_block_175.out0, item1=code_block_175.out1, item2=code_block_175.out2, item3=code_block_175.out3, item4=code_block_175.out4, item5=code_block_175.out5, item6=code_block_175.out6, item7=code_block_175.out7, item8=code_block_175.out8, item9=code_block_175.out9, item10=code_block_175.out10, item11=code_block_175.out11, item12=code_block_175.out12)
matchWithKeyValues = Custom[List.MatchWithKeyValues](seq=list_getitematindex_fill_color, keys=create, values=create)  # package Clockwork for Dynamo 2.x; Matches a list with a given set of keys and returns the values corresponding to the keys
byName = Material.ByName(name=matchWithKeyValues)
# note: this node colorizes each box
# according to the Deparment
# list by replacing the material
# ("Fill Color")
setParameterByName_5 = Element.SetParameterByName(element=flatten_7, parameterName=code_block_174, value=byName)
code_block_176 = CodeBlock { "Interior Finish"; }
setParameterByName_6 = Element.SetParameterByName(element=byPointAndLevel, parameterName=code_block_176, value=chop_7)
code_block_177 = CodeBlock { "Exterior Finish"; }
setParameterByName_7 = Element.SetParameterByName(element=byPointAndLevel, parameterName=code_block_177, value=chop_8)
code_block_178 = CodeBlock { "Department"; }
# note: this series of nodes assigns
# the selected sublists to certain
# parameters in the space planning
# family
setParameterByName_8 = Element.SetParameterByName(element=byPointAndLevel, parameterName=code_block_178, value=dicipline_2)
code_block_179 = CodeBlock { "Room Name"; }
setParameterByName_9 = Element.SetParameterByName(element=byPointAndLevel, parameterName=code_block_179, value=room_name)
code_block_180 = CodeBlock { "Elevation from Level"; 0; }
setParameterByName_10 = Element.SetParameterByName(element=byPointAndLevel, parameterName=code_block_180.out0, value=code_block_180.out1)

elevation = Level.Elevation(level=ofRepeatedItem_6)
# note: pick the level the families
# should populate on
levels = Levels("GF")  # graph input
code_block_181 = CodeBlock(input=code_block_16) { input; }
code_block_182 = CodeBlock(i=code_block_181) { i["header"]; }
