# Dynamo graph 1a_Mass Arrangement (by Building List)(220623).dyn "1a_Mass Arrangement (by Building List)(1218)" (Dynamo 2.12.0.5650)

# group: Data 전처리 구간- Building List Parser

# group: Excel Import 구간

# group: 패밀리 선택
# note: select the space planning family with the corresponding parameters to be overwritten by Dynamo
family_types = FamilyTypes("Space Planning Box_hec:Space Planning Box_hec")  # graph input

# group: Input_Excel related
file_path = Filename(".\01_Building List_Pilot Project_2022_0218.xlsx")  # graph input
sheet_name = StringInput("Building List")  # graph input

# group: Import Excel(By OpenpyXl)
python_script = Python(IN[0]=file_path, IN[1]=sheet_name)  # CPython3
# ---------- python_script.python (90 lines) ----------
# Load the Python Standard and DesignScript Libraries
import os
python_rootpath = os.getenv('LOCALAPPDATA')+'\Programs\Python'
file_list = os.listdir(python_rootpath)
python_version = file_list[-1]
import sys
sys.path.append(os.getenv('LOCALAPPDATA').replace('\\','\\\\') + f'\Programs\Python\{python_version}\Lib\site-packages')
import clr
clr.AddReference('RevitAPI')
import Autodesk

clr.AddReference('ProtoGeometry')
from Autodesk.DesignScript.Geometry import *

clr.AddReference('RevitNodes')
import Revit
clr.ImportExtensions(Revit.Elements)

clr.ImportExtensions(Revit.GeometryConversion)
clr.ImportExtensions(Revit.GeometryReferences)

clr.AddReference('RevitServices')
import RevitServices
from RevitServices.Persistence import DocumentManager
from RevitServices.Transactions import TransactionManager

doc = DocumentManager.Instance.CurrentDBDocument

import random
import itertools
from functools import reduce
from collections import Iterable
import datetime
import openpyxl

# The inputs to this node will be stored as a list in the IN variables.
dataEnteringNode = IN
inputFilePath = IN[0]
inputSheetName = IN[1]

def importExcel(path, SheetNameIn):
    wb_obj = openpyxl.load_workbook(str(path), data_only=True)
    sheet_obj = wb_obj.get_sheet_by_name(str(SheetNameIn))

    m_row = sheet_obj.max_row
    m_col = sheet_obj.max_column

    listOut = []

    for i in range(1, m_row +1):
        listTemp = []
        for j in range(1, m_col + 1):
            cell_obj = sheet_obj.cell(row=i, column=j)
            listTemp.append(cell_obj.value)
            if len(listTemp) == m_col:
                listOut.append(listTemp)
    return listOut

def checkAllElement(list, target):
    tmp=[]
    for i in list:
        if i == target:
            tmp.append(True)
        else:
            tmp.append(False)
    return all(tmp)


# Place your code below this line

result = importExcel(inputFilePath, inputSheetName)

for i in result:## null만 있는 Excel Row 제거
    if checkAllElement(i, None):
        result.remove(i)
    else:
        pass
        
result_tr = list(zip(*result))

for i in result_tr:## null만 있는 Excel Column 제거
    if checkAllElement(i, None):
        result_tr.remove(i)
    else:
        pass

result = list(zip(*result_tr))

# Assign your output to the OUT variable.
OUT = result
# ----------------------------------------

# group: 절대좌표 바깥쪽 불필요 데이터 제거
firstItem = List.FirstItem(list=python_script)
string_from_object = FromObject(object=firstItem)
code_block = CodeBlock { "null"; }
allIndicesOf = List.AllIndicesOf(list=string_from_object, item=code_block)
removeItemAtIndex = List.RemoveItemAtIndex(list=python_script@L2, indices=allIndicesOf)

headerRowIdx = DoubleInput(3)  # graph input

# group: 시트 헤더 분리 및 필요 칼럼 인덱스 추출
code_block_2 = CodeBlock(i=headerRowIdx) { i; }
getItemAtIndex = List.GetItemAtIndex(list=removeItemAtIndex, index=code_block_2)
string_from_object_2 = FromObject(object=getItemAtIndex)
code_block_3 = CodeBlock { "_"; }
startsWith = String.StartsWith(string=string_from_object_2, searchFor=code_block_3)
code_block_4 = CodeBlock { false; }
allIndicesOf_2 = List.AllIndicesOf(list=startsWith, item=code_block_4)
getItemAtIndex_2 = List.GetItemAtIndex(list=getItemAtIndex, index=allIndicesOf_2)

# group: 시트 타이틀 및 헤더 제거 및 불필요 칼럼 제거
code_block_5 = CodeBlock(i=headerRowIdx) { 1..i; }
removeItemAtIndex_2 = List.RemoveItemAtIndex(list=removeItemAtIndex, indices=code_block_5)
getItemAtIndex_3 = List.GetItemAtIndex(list=removeItemAtIndex_2@L2, index=allIndicesOf_2)

# group: 절대좌표와 Building Name 칼럼 추출
transpose = List.Transpose(lists=getItemAtIndex_3)
code_block_6 = CodeBlock { "Building Name"; }
firstIndexOf = List.FirstIndexOf(list=getItemAtIndex_2, item=code_block_6)
code_block_7 = CodeBlock(i=firstIndexOf)
# ---------- code_block_7.designscript (3 lines) ----------
[0,i];
//index[0]은 절대좌표
//index[i]은 Building Name
# ----------------------------------------
getItemAtIndex_4 = List.GetItemAtIndex(list=transpose, index=code_block_7)

# group: 건물별 분리기준 행 추출
string_from_object_3 = FromObject(object=getItemAtIndex_4)
lastItem = List.LastItem(list=string_from_object_3)

# group: 건물별 분리
code_block_8 = CodeBlock { 0; "null"; }
replaceItemAtIndex = List.ReplaceItemAtIndex(list=lastItem, index=code_block_8.out0, item=code_block_8.out1)
code_block_9 = CodeBlock(i=replaceItemAtIndex) { i != "null"; true; }
allIndicesOf_3 = List.AllIndicesOf(list=code_block_9.out0, item=code_block_9.out1)
전체_데이터_by_row = CodeBlock(i=transpose) { i; }
절대좌표_by_row = CodeBlock(i=전체_데이터_by_row) { i[0]; }
count = List.Count(list=절대좌표_by_row)
join = List.Join(list0=allIndicesOf_3, list1=count)
index_finder_건물별_row = Python(IN[0]=join)  # CPython3
# ---------- index_finder_건물별_row.python (22 lines) ----------
# Load the Python Standard and DesignScript Libraries
import sys
import clr
clr.AddReference('ProtoGeometry')
from Autodesk.DesignScript.Geometry import *

# The inputs to this node will be stored as a list in the IN variables.
dataEnteringNode = IN

inputIndex = IN[0]
# Place your code below this line
result = []

for i in range(len(inputIndex)):
    if i+1 < len(inputIndex):
        result.append(range(inputIndex[i], inputIndex[i+1]))
    else:
        pass


# Assign your output to the OUT variable.
OUT = result
# ----------------------------------------
getItemAtIndex_5 = List.GetItemAtIndex(list=transpose@L2, index=index_finder_건물별_row@L2, lacing=CrossProduct)
transpose_2 = List.Transpose(lists=getItemAtIndex_5)

# group: 건물선택
건물선택 = StringInput("Central")  # graph input

# group: 건물선택
건물별_그룹데이터_by_column = CodeBlock(i=transpose_2) { i; }
code_block_10 = CodeBlock { 3; }
getItemAtIndex_6 = List.GetItemAtIndex(list=건물별_그룹데이터_by_column@L3, index=code_block_10)
firstItem_2 = List.FirstItem(list=getItemAtIndex_6@L2)
contains = String.Contains(string=firstItem_2, searchFor=건물선택)
code_block_11 = CodeBlock { true; }
firstIndexOf_2 = List.FirstIndexOf(list=contains, item=code_block_11)
getItemAtIndex_7 = List.GetItemAtIndex(list=건물별_그룹데이터_by_column, index=firstIndexOf_2)

# group: 불필요 Row 제거
시트_헤더 = CodeBlock(i=getItemAtIndex_2) { i; }
string_from_object_4 = FromObject(object=시트_헤더)
code_block_12 = CodeBlock { "Room Name"; }
contains_2 = String.Contains(string=string_from_object_4, searchFor=code_block_12)
code_block_13 = CodeBlock { true; }
firstIndexOf_3 = List.FirstIndexOf(list=contains_2, item=code_block_13)
getItemAtIndex_8 = List.GetItemAtIndex(list=getItemAtIndex_7, index=firstIndexOf_3)
string_from_object_5 = FromObject(object=getItemAtIndex_8)
code_block_14 = CodeBlock(i=string_from_object_5) { i=="null"?false:true; true; }
allIndicesOf_4 = List.AllIndicesOf(list=code_block_14.out0, item=code_block_14.out1)
getItemAtIndex_9 = List.GetItemAtIndex(list=getItemAtIndex_7@L2, index=allIndicesOf_4)

# group: header별 데이터 딕셔너리 형성
시트_헤더_2 = CodeBlock(i=getItemAtIndex_2) { i; }
code_block_15 = CodeBlock { 1; }
list_dropitems_절대좌표제거 = List.DropItems(list=시트_헤더_2, amount=code_block_15)
string_from_object_6 = FromObject(object=list_dropitems_절대좌표제거)
code_block_16 = CodeBlock { 1; }
list_dropitems_절대좌표제거_2 = List.DropItems(list=getItemAtIndex_9, amount=code_block_16)
createDictionary = Python(IN[0]=string_from_object_6, IN[1]=list_dropitems_절대좌표제거_2)  # CPython3
# ---------- createDictionary.python (22 lines) ----------
# Load the Python Standard and DesignScript Libraries
import sys
import clr
clr.AddReference('ProtoGeometry')
from Autodesk.DesignScript.Geometry import *

# The inputs to this node will be stored as a list in the IN variables.
dataEnteringNode = IN

inputKeys = IN[0]
inputValues = IN[1]

# Place your code below this line

dict = {}
for i in range(len(inputKeys)):
    dict[inputKeys[i]] = inputValues[i]
    
result = dict

# Assign your output to the OUT variable.
OUT = result
# ----------------------------------------

code_block_17 = CodeBlock(header=string_from_object_6, data=createDictionary, data_nondic=list_dropitems_절대좌표제거_2)
# ---------- code_block_17.designscript (5 lines) ----------
{
"header": _header,
"data": _data,
"data_nondic": _data_nondic
};
# ----------------------------------------

# group: 속성별 데이터 분류-Width
code_block_18 = CodeBlock(input=code_block_17) { input; }
code_block_19 = CodeBlock(i=code_block_18) { i["data"]; }
code_block_20 = CodeBlock(i=code_block_18) { i["header"]; }
integer_slider = IntegerSlider(9, range=0..70 step 1)
code_block_21 = CodeBlock(i=code_block_20, j=integer_slider) { i[j]; }
watch = Watch(code_block_21)
valueAtKey = DesignScript.Builtin.Dictionary.ValueAtKey(dictionary=code_block_19, key=watch)

# group: Multiplying instances of WIDTH by the QUANTITY column from spreadsheet
code_block_22 = CodeBlock(i=valueAtKey) { i*1000; }
count_2 = List.Count(list=code_block_22@L1)
# note: multiplies each Department
# by the associated value in the
# QUANTITY column from the
# Excel file
ofRepeatedItem = List.OfRepeatedItem(item=code_block_22@L1, amount=count_2@L1)
# note: consolidate all sublist
# groups into one seamless list
flatten = List.Flatten(list=ofRepeatedItem)

# group: 속성별 데이터 분류-Floor
code_block_23 = CodeBlock(input=code_block_17) { input; }
code_block_24 = CodeBlock(i=code_block_23) { i["data"]; }
code_block_25 = CodeBlock(i=code_block_23) { i["header"]; }
integer_slider_2 = IntegerSlider(6, range=0..70 step 1)
code_block_26 = CodeBlock(i=code_block_25, j=integer_slider_2) { i[j]; }
watch_2 = Watch(code_block_26)
valueAtKey_2 = DesignScript.Builtin.Dictionary.ValueAtKey(dictionary=code_block_24, key=watch_2)

# group: SORTING: This sequence of creates a new list of sequential unique index number to later be paired with all Department values from the Excel spreadsheet
code_block_27 = CodeBlock { 0; }
# note: flips data to be grouped
# by column not row
# note: select 'Floor'
count_3 = List.Count(list=valueAtKey_2@L1)
# note: multiplies each Department
# by the associated value in the
# QUANTITY column from the
# Excel file
ofRepeatedItem_2 = List.OfRepeatedItem(item=valueAtKey_2@L1, amount=count_3@L1)
# note: consolidate all sublist
# groups into one seamless list
flatten_2 = List.Flatten(list=ofRepeatedItem_2)
# note: From Clockwork package:
# Counts number of times each
# unique item (department) occurs.
# Output:
# 1. list of unique items
# 2. number of occurences
층별_갯수_계산 = CodeBlock(i=flatten_2) { j = List.UniqueItems(i); blnlist = i==j<1>; List.CountTrue(blnlist<1>); }
# note: From LunchBox package:
# Recursive Function -
# adds each item in the list
# to the sum of the values
# before it until the list is
# exhausted.
python_script_2 = Python(IN[0]=층별_갯수_계산.out2)  # CPython3
# ---------- python_script_2.python (22 lines) ----------
# Load the Python Standard and DesignScript Libraries
import sys
import clr
clr.AddReference('ProtoGeometry')
from Autodesk.DesignScript.Geometry import *

# The inputs to this node will be stored as a list in the IN variables.
dataEnteringNode = IN
inList = IN[0]
outList = []

# Place your code below this line
acc = 0
for i in inList:
	acc = acc + i
	outList.append(acc)
	



# Assign your output to the OUT variable.
OUT = outList
# ----------------------------------------
# note: Adds 0 to the front
# of the list so every
# count starts at 0
addItemToFront = List.AddItemToFront(item=code_block_27, list=python_script_2)
# note: Since 0 is included as an index,
# need to reduce the list by 1 to
# maintain the actual number of
# items
code_block_28 = CodeBlock(x=python_script_2) { x-1; }
# note: Assigns a unique number
#  to each Department
# occurence
code_block_29 = CodeBlock(x=addItemToFront, y=code_block_28) { x..y; }

getItemAtIndex_10 = List.GetItemAtIndex(list=flatten, index=code_block_29)
integer_slider_3 = IntegerSlider(20000, range=0..20000 step 5)
code_block_30 = CodeBlock(SPACER=integer_slider_3) { SPACER; }

# group: 속성별 데이터 분류-Length
code_block_31 = CodeBlock(input=code_block_17) { input; }
code_block_32 = CodeBlock(i=code_block_31) { i["data"]; }
code_block_33 = CodeBlock(i=code_block_31) { i["header"]; }
integer_slider_4 = IntegerSlider(10, range=0..70 step 1)
code_block_34 = CodeBlock(i=code_block_33, j=integer_slider_4) { i[j]; }
watch_3 = Watch(code_block_34)
valueAtKey_3 = DesignScript.Builtin.Dictionary.ValueAtKey(dictionary=code_block_32, key=watch_3)

# group: Multiplying instances of LENGTH by the QUANTITY column from spreadsheet
code_block_35 = CodeBlock(i=valueAtKey_3) { i*1000; }
count_4 = List.Count(list=code_block_35@L1)
# note: multiplies each Department
# by the associated value in the
# QUANTITY column from the
# Excel file
ofRepeatedItem_3 = List.OfRepeatedItem(item=code_block_35@L1, amount=count_4@L1)
# note: consolidate all sublist
# groups into one seamless list
flatten_3 = List.Flatten(list=ofRepeatedItem_3)

getItemAtIndex_11 = List.GetItemAtIndex(list=flatten_3, index=code_block_29)

# group: SPACING: Using Recursive function to evenly space centroid coordinates based on program widths from spreadsheet.
# note: "helper node":
# re-positioning for
# cleaning up canvas
code_block_36 = CodeBlock(list=getItemAtIndex_10) { list; }
# note: cut all Width values in half
code_block_37 = CodeBlock(a=code_block_36) { a/2; }
code_block_38 = CodeBlock { 1; }
# note: rotate all values in list
# by one position...
# end comes front,
# everything else moves
# down one index
shiftIndices = List.ShiftIndices(list=code_block_37@L2, amount=code_block_38)
# note: buffer: two mapped nodes
# in a row made the second
# function replace an additional
# index... this fixes glitch
code_block_39 = CodeBlock(x=shiftIndices) { x; }
code_block_40 = CodeBlock { 0; }
# note: replace the first item in
# each sublist with 0 as
# starting position for the
# first point
replaceItemAtIndex_2 = List.ReplaceItemAtIndex(list=code_block_39@L2, index=code_block_40, item=code_block_40)
# note: count the number of
# items in every sublist
count_5 = List.Count(list=code_block_36@L2)
# note: Since 0 is included as an index,
# need to reduce the list by 1 to
# maintain the actual number of
# items
code_block_41 = CodeBlock(n=count_5) { n-1; }
# note: copy the spacer value
# as many times as the
# number of items in
# every sublist
ofRepeatedItem_4 = List.OfRepeatedItem(item=code_block_30, amount=code_block_41)
code_block_42 = CodeBlock { 0; }
# note: replace the first item in
# each sublist with 0 so the
# spacing occurs after the
# first instance
insert = List.Insert(list=ofRepeatedItem_4@L2, element=code_block_42, index=code_block_42)
# note: pair the three lists together:
# 1. half the width values from the first item
# 2. half the width values from the next item
# 3. the space value between points
code_block_43 = CodeBlock(a=code_block_37, b=replaceItemAtIndex_2, c=insert) { [a,b,c]; }
# note: these Transpose functions re-sort the sublist so that the values are grouped by individual width values for each point
transpose_3 = List.Transpose(lists=code_block_43)
transpose_4 = List.Transpose(lists=transpose_3@L3)
# note: sum each with sublist
# to get total point distance
sum = Math.Sum(values=transpose_4)
# note: From LunchBox package:
# Recursive Function -
# adds each item in the list
# to the sum of the values
# before it until the list is
# exhausted...
# Spaces each point along the X Axis
python_script_3 = Python(IN[0]=sum)  # CPython3
# ---------- python_script_3.python (27 lines) ----------
# Load the Python Standard and DesignScript Libraries
import sys
import clr
clr.AddReference('ProtoGeometry')
from Autodesk.DesignScript.Geometry import *

# The inputs to this node will be stored as a list in the IN variables.
dataEnteringNode = IN
inList = IN[0]
outList = []

# Place your code below this line


for i in inList:
	acc = 0
	for j in i:
		acc = acc + j
		outList.append(acc)
#	for j in i:
#		acc = acc + j
#		outList.append([acc])



# Assign your output to the OUT variable.
OUT = outList
# ----------------------------------------
count_6 = List.Count(list=sum@L2)
chop = List.Chop(list=python_script_3, lengths=count_6)
# note: Collect the largest Length value
maximumItem = List.MaximumItem(list=getItemAtIndex_11)
# note: cut all Length values in half
code_block_44 = CodeBlock(a=maximumItem) { [a/2]; }
# note: consolidate all sublist
# groups into one seamless list
flatten_4 = List.Flatten(list=code_block_44)
code_block_45 = CodeBlock { 1; }
shiftIndices_2 = List.ShiftIndices(list=flatten_4, amount=code_block_45)
code_block_46 = CodeBlock { 0; }
# note: replace with 0 as
# starting position for
# the first point
replaceItemAtIndex_3 = List.ReplaceItemAtIndex(list=shiftIndices_2, index=code_block_46, item=code_block_46)
count_7 = List.Count(list=maximumItem)
code_block_47 = CodeBlock(n=count_7) { n-1; }
ofRepeatedItem_5 = List.OfRepeatedItem(item=code_block_30, amount=code_block_47)
code_block_48 = CodeBlock { 0; }
insert_2 = List.Insert(list=ofRepeatedItem_5, element=code_block_48, index=code_block_48)
# note: pair the three lists together:
# 1. half the length values from the first item
# 2. half the length values from the next item
# 3. the space value between points
code_block_49 = CodeBlock(a=flatten_4, b=replaceItemAtIndex_3, c=insert_2) { [a,b,c]; }
# note: this Transpose function re-sorts the sublist so that the values are grouped by individual width values for each point
transpose_5 = List.Transpose(lists=code_block_49)
sum_2 = Math.Sum(values=transpose_5)
python_script_4 = Python(IN[0]=sum_2)  # CPython3; same code as python_script_2

# group: 층별 갯수 계산
code_block_50 = CodeBlock { "countByFloor"; }
code_block_51 = CodeBlock(input=code_block_17) { input; }
components = DesignScript.Builtin.Dictionary.Components(dictionary=code_block_51)
addItemToEnd = List.AddItemToEnd(item=code_block_50, list=components.keys)
code_block_52 = CodeBlock(i=code_block_51) { i["data"]; }
code_block_53 = CodeBlock(i=code_block_51) { i["header"]; }
integer_slider_5 = IntegerSlider(6, range=0..70 step 1)
code_block_54 = CodeBlock(i=code_block_53, j=integer_slider_5) { i[j]; }
watch_4 = Watch(code_block_54)
valueAtKey_4 = DesignScript.Builtin.Dictionary.ValueAtKey(dictionary=code_block_52, key=watch_4)
층별_갯수_계산_2 = CodeBlock(i=valueAtKey_4) { j = List.UniqueItems(i); blnlist = i==j<1>; List.CountTrue(blnlist<1>); }
addItemToEnd_2 = List.AddItemToEnd(item=층별_갯수_계산_2.out2, list=components.values)
byKeysValues = DesignScript.Builtin.Dictionary.ByKeysValues(keys=addItemToEnd, values=addItemToEnd_2)

# group: Revit 레벨 추출 및 지하층 포함 여부 선택 구간
지하층_포함_여부 = BoolSelector(false)  # graph input
element_types = ElementTypes("Level")
all_elements_of_type = ElementsOfType(element_type=element_types)
string_from_object_7 = FromObject(object=all_elements_of_type)
code_block_55 = CodeBlock { "B"; }
contains_3 = String.Contains(string=string_from_object_7, searchFor=code_block_55)
filterByBoolMask = List.FilterByBoolMask(list=all_elements_of_type, mask=contains_3)
IF = Python(IN[0]=지하층_포함_여부, IN[1]=all_elements_of_type, IN[2]=filterByBoolMask.out)  # CPython3
# ---------- IF.python (45 lines) ----------
# Load the Python Standard and DesignScript Libraries
import sys
import clr
clr.AddReference('ProtoGeometry')
from Autodesk.DesignScript.Geometry import *

# The inputs to this node will be stored as a list in the IN variables.
dataEnteringNode = IN

# Place your code below this line
def chk_CountOfBlns(_blns):
    
    if isinstance(_blns, list):
        return True
    else:
        return False

def TestForLists(_args):
    blns = _args[0]
    
    def unitTest(_argsSet):
        (testBln, resTrue, resFalse) = _argsSet
        
        if testBln:
            return resTrue
        else:
            return resFalse
    
    def wholeTest(_args):
        if _args[0]:
            return _args[1]
        else:
            return _args[2]
    
    if chk_CountOfBlns(blns):
        _argsSets = list(zip(*IN))
        res = map(unitTest, _argsSets)
    else:
        res = wholeTest(_args)
        
    return res


# Assign your output to the OUT variable.
OUT = TestForLists(IN)
# ----------------------------------------
code_block_56 = CodeBlock(input=byKeysValues) { input; }
code_block_57 = CodeBlock(i=code_block_56) { i["countByFloor"]; }
ofRepeatedItem_6 = List.OfRepeatedItem(item=IF, amount=code_block_57, lacing=Longest)

# group: INSTANTIATION: Placing Space Planning family at centroid coordinates.
byCoordinates = Point.ByCoordinates(x=chop)
byCoordinates_2 = Vector.ByCoordinates(y=python_script_4)
# note: Create points according to the
# calculated Width values along
# the X Axis...
# Locate the points along the
# Y Axis according to the calculated
# Length values
add = Point.Add(point=byCoordinates@L2, vectorToAdd=byCoordinates_2@L1)
# note: places an instance of the family
# at each point location
byPointAndLevel = FamilyInstance.ByPointAndLevel(familyType=family_types, point=add, level=ofRepeatedItem_6)

# group: 속성별 데이터 분류-by Grouped as Floor @ Width
code_block_58 = CodeBlock(input=byKeysValues) { input; }
code_block_59 = CodeBlock(i=code_block_58) { i["data"]; }
code_block_60 = CodeBlock(i=code_block_58) { i["header"]; }
integer_slider_6 = IntegerSlider(9, range=0..70 step 1)
code_block_61 = CodeBlock(i=code_block_60, j=integer_slider_6) { i[j]; }
watch_5 = Watch(code_block_61)
valueAtKey_5 = DesignScript.Builtin.Dictionary.ValueAtKey(dictionary=code_block_59, key=watch_5)
code_block_62 = CodeBlock(i=code_block_58) { i["countByFloor"]; }
chop_2 = List.Chop(list=valueAtKey_5, lengths=code_block_62)
length = CodeBlock(result=chop_2) { result*1000; }

# group: 속성별 데이터 분류-by Grouped as Floor @ Length
code_block_63 = CodeBlock(input=byKeysValues) { input; }
code_block_64 = CodeBlock(i=code_block_63) { i["data"]; }
code_block_65 = CodeBlock(i=code_block_63) { i["header"]; }
integer_slider_7 = IntegerSlider(10, range=0..70 step 1)
code_block_66 = CodeBlock(i=code_block_65, j=integer_slider_7) { i[j]; }
watch_6 = Watch(code_block_66)
valueAtKey_6 = DesignScript.Builtin.Dictionary.ValueAtKey(dictionary=code_block_64, key=watch_6)
code_block_67 = CodeBlock(i=code_block_63) { i["countByFloor"]; }
chop_3 = List.Chop(list=valueAtKey_6, lengths=code_block_67)
length_2 = CodeBlock(result=chop_3) { result*1000; }

# group: 속성별 데이터 분류-by Grouped as Floor @ Area
code_block_68 = CodeBlock(input=byKeysValues) { input; }
code_block_69 = CodeBlock(i=code_block_68) { i["data"]; }
code_block_70 = CodeBlock(i=code_block_68) { i["header"]; }
integer_slider_8 = IntegerSlider(14, range=0..70 step 1)
code_block_71 = CodeBlock(i=code_block_70, j=integer_slider_8) { i[j]; }
watch_7 = Watch(code_block_71)
valueAtKey_7 = DesignScript.Builtin.Dictionary.ValueAtKey(dictionary=code_block_69, key=watch_7)
code_block_72 = CodeBlock(i=code_block_68) { i["countByFloor"]; }
chop_4 = List.Chop(list=valueAtKey_7, lengths=code_block_72)
code_block_73 = CodeBlock { 0; }
isNull = Object.IsNull()  # unwired: object
replaceByCondition = Replace(item=chop_4, replaceWith=code_block_73, condition=isNull)
area = CodeBlock(result=replaceByCondition) { result; }

# group: 속성별 데이터 분류-by Grouped as Floor @ Height
code_block_74 = CodeBlock(input=byKeysValues) { input; }
code_block_75 = CodeBlock(i=code_block_74) { i["data"]; }
code_block_76 = CodeBlock(i=code_block_74) { i["header"]; }
integer_slider_9 = IntegerSlider(11, range=0..70 step 1)
code_block_77 = CodeBlock(i=code_block_76, j=integer_slider_9) { i[j]; }
watch_8 = Watch(code_block_77)
valueAtKey_8 = DesignScript.Builtin.Dictionary.ValueAtKey(dictionary=code_block_75, key=watch_8)
code_block_78 = CodeBlock(i=code_block_74) { i["countByFloor"]; }
chop_5 = List.Chop(list=valueAtKey_8, lengths=code_block_78)
height = CodeBlock(result=chop_5) { result*1000; }

# group: 속성별 데이터 분류-by Grouped as Floor @ Dicipline Colour
code_block_79 = CodeBlock(input=byKeysValues) { input; }
code_block_80 = CodeBlock(i=code_block_79) { i["data"]; }
code_block_81 = CodeBlock(i=code_block_79) { i["header"]; }
integer_slider_10 = IntegerSlider(-7, range=-7..70 step 1)
code_block_82 = CodeBlock(i=code_block_81, j=integer_slider_10) { i[j]; }
watch_9 = Watch(code_block_82)
valueAtKey_9 = DesignScript.Builtin.Dictionary.ValueAtKey(dictionary=code_block_80, key=watch_9)
code_block_83 = CodeBlock(i=code_block_79) { i["countByFloor"]; }
chop_6 = List.Chop(list=valueAtKey_9, lengths=code_block_83)
dicipline = CodeBlock(result=chop_6) { result; }

# group: 속성별 데이터 분류-by Grouped as Floor @ Int. Wall Finish
code_block_84 = CodeBlock { ".."; }
code_block_85 = CodeBlock(input=byKeysValues) { input; }
code_block_86 = CodeBlock(i=code_block_85) { i["data_nondic"]; }
code_block_87 = CodeBlock(i=code_block_85) { i["header"]; }
code_block_88 = CodeBlock { "Int."; }
contains_4 = String.Contains(string=code_block_87, searchFor=code_block_88)
code_block_89 = CodeBlock { true; }
allIndicesOf_5 = List.AllIndicesOf(list=contains_4, item=code_block_89)
getItemAtIndex_12 = List.GetItemAtIndex(list=code_block_86, index=allIndicesOf_5)
getItemAtIndex_13 = List.GetItemAtIndex(list=code_block_87, index=allIndicesOf_5)
code_block_90 = CodeBlock { "Wall"; }
contains_5 = String.Contains(string=getItemAtIndex_13, searchFor=code_block_90)
code_block_91 = CodeBlock { true; }
allIndicesOf_6 = List.AllIndicesOf(list=contains_5, item=code_block_91)
getItemAtIndex_14 = List.GetItemAtIndex(list=getItemAtIndex_12, index=allIndicesOf_6)
code_block_92 = CodeBlock { "N/A"; }
isNull_2 = Object.IsNull()  # unwired: object
replaceByCondition_2 = Replace(item=getItemAtIndex_14, replaceWith=code_block_92, condition=isNull_2)
transpose_6 = List.Transpose(lists=replaceByCondition_2)
join_2 = String.Join(separator=code_block_84, string0=transpose_6@L2)

# group: string 검사
code_block_93 = CodeBlock(input=join_2) { input; }
code_block_94 = CodeBlock { ".."; }
endsWith = String.EndsWith(string=code_block_93, searchFor=code_block_94)
code_block_95 = CodeBlock { -1; }
code_block_96 = CodeBlock { -2; }
remove = String.Remove(string=code_block_93, startIndex=code_block_95, count=code_block_96)
IF_2 = Python(IN[0]=endsWith, IN[1]=remove, IN[2]=code_block_93)  # CPython3; same code as IF

# group: 속성별 데이터 분류-by Grouped as Floor @ Int. Base Finish
code_block_97 = CodeBlock { ".."; }
code_block_98 = CodeBlock(input=byKeysValues) { input; }
code_block_99 = CodeBlock(i=code_block_98) { i["data_nondic"]; }
code_block_100 = CodeBlock(i=code_block_98) { i["header"]; }
code_block_101 = CodeBlock { "Int."; }
contains_6 = String.Contains(string=code_block_100, searchFor=code_block_101)
code_block_102 = CodeBlock { true; }
allIndicesOf_7 = List.AllIndicesOf(list=contains_6, item=code_block_102)
getItemAtIndex_15 = List.GetItemAtIndex(list=code_block_99, index=allIndicesOf_7)
getItemAtIndex_16 = List.GetItemAtIndex(list=code_block_100, index=allIndicesOf_7)
code_block_103 = CodeBlock { "Base"; }
contains_7 = String.Contains(string=getItemAtIndex_16, searchFor=code_block_103)
code_block_104 = CodeBlock { true; }
allIndicesOf_8 = List.AllIndicesOf(list=contains_7, item=code_block_104)
getItemAtIndex_17 = List.GetItemAtIndex(list=getItemAtIndex_15, index=allIndicesOf_8)
code_block_105 = CodeBlock { "N/A"; }
isNull_3 = Object.IsNull()  # unwired: object
replaceByCondition_3 = Replace(item=getItemAtIndex_17, replaceWith=code_block_105, condition=isNull_3)
transpose_7 = List.Transpose(lists=replaceByCondition_3)
join_3 = String.Join(separator=code_block_97, string0=transpose_7@L2)

# group: string 검사
code_block_106 = CodeBlock(input=join_3) { input; }
code_block_107 = CodeBlock { ".."; }
endsWith_2 = String.EndsWith(string=code_block_106, searchFor=code_block_107)
code_block_108 = CodeBlock { -1; }
code_block_109 = CodeBlock { -2; }
remove_2 = String.Remove(string=code_block_106, startIndex=code_block_108, count=code_block_109)
IF_3 = Python(IN[0]=endsWith_2, IN[1]=remove_2, IN[2]=code_block_106)  # CPython3; same code as IF

# group: 속성별 데이터 분류-by Grouped as Floor @ Int. Floor Finish
code_block_110 = CodeBlock { ".."; }
code_block_111 = CodeBlock(input=byKeysValues) { input; }
code_block_112 = CodeBlock(i=code_block_111) { i["data_nondic"]; }
code_block_113 = CodeBlock(i=code_block_111) { i["header"]; }
code_block_114 = CodeBlock { "Int."; }
contains_8 = String.Contains(string=code_block_113, searchFor=code_block_114)
code_block_115 = CodeBlock { true; }
allIndicesOf_9 = List.AllIndicesOf(list=contains_8, item=code_block_115)
getItemAtIndex_18 = List.GetItemAtIndex(list=code_block_112, index=allIndicesOf_9)
getItemAtIndex_19 = List.GetItemAtIndex(list=code_block_113, index=allIndicesOf_9)
code_block_116 = CodeBlock { "Floor"; }
contains_9 = String.Contains(string=getItemAtIndex_19, searchFor=code_block_116)
code_block_117 = CodeBlock { true; }
allIndicesOf_10 = List.AllIndicesOf(list=contains_9, item=code_block_117)
getItemAtIndex_20 = List.GetItemAtIndex(list=getItemAtIndex_18, index=allIndicesOf_10)
code_block_118 = CodeBlock { "N/A"; }
isNull_4 = Object.IsNull()  # unwired: object
replaceByCondition_4 = Replace(item=getItemAtIndex_20, replaceWith=code_block_118, condition=isNull_4)
transpose_8 = List.Transpose(lists=replaceByCondition_4)
join_4 = String.Join(separator=code_block_110, string0=transpose_8@L2)

# group: string 검사
code_block_119 = CodeBlock(input=join_4) { input; }
code_block_120 = CodeBlock { ".."; }
endsWith_3 = String.EndsWith(string=code_block_119, searchFor=code_block_120)
code_block_121 = CodeBlock { -1; }
code_block_122 = CodeBlock { -2; }
remove_3 = String.Remove(string=code_block_119, startIndex=code_block_121, count=code_block_122)
IF_4 = Python(IN[0]=endsWith_3, IN[1]=remove_3, IN[2]=code_block_119)  # CPython3; same code as IF

# group: 속성별 데이터 분류-by Grouped as Floor @ Int. Ceiling Finish
code_block_123 = CodeBlock { ".."; }
code_block_124 = CodeBlock(input=byKeysValues) { input; }
code_block_125 = CodeBlock(i=code_block_124) { i["data_nondic"]; }
code_block_126 = CodeBlock(i=code_block_124) { i["header"]; }
code_block_127 = CodeBlock { "Int."; }
contains_10 = String.Contains(string=code_block_126, searchFor=code_block_127)
code_block_128 = CodeBlock { true; }
allIndicesOf_11 = List.AllIndicesOf(list=contains_10, item=code_block_128)
getItemAtIndex_21 = List.GetItemAtIndex(list=code_block_125, index=allIndicesOf_11)
getItemAtIndex_22 = List.GetItemAtIndex(list=code_block_126, index=allIndicesOf_11)
code_block_129 = CodeBlock { "Ceiling"; }
contains_11 = String.Contains(string=getItemAtIndex_22, searchFor=code_block_129)
code_block_130 = CodeBlock { true; }
allIndicesOf_12 = List.AllIndicesOf(list=contains_11, item=code_block_130)
getItemAtIndex_23 = List.GetItemAtIndex(list=getItemAtIndex_21, index=allIndicesOf_12)
code_block_131 = CodeBlock { "N/A"; }
isNull_5 = Object.IsNull()  # unwired: object
replaceByCondition_5 = Replace(item=getItemAtIndex_23, replaceWith=code_block_131, condition=isNull_5)
transpose_9 = List.Transpose(lists=replaceByCondition_5)
join_5 = String.Join(separator=code_block_123, string0=transpose_9@L2)

# group: string 검사
code_block_132 = CodeBlock(input=join_5) { input; }
code_block_133 = CodeBlock { ".."; }
endsWith_4 = String.EndsWith(string=code_block_132, searchFor=code_block_133)
code_block_134 = CodeBlock { -1; }
code_block_135 = CodeBlock { -2; }
remove_4 = String.Remove(string=code_block_132, startIndex=code_block_134, count=code_block_135)
IF_5 = Python(IN[0]=endsWith_4, IN[1]=remove_4, IN[2]=code_block_132)  # CPython3; same code as IF

code_block_136 = CodeBlock(i=code_block_85) { i["countByFloor"]; }

# group: 속성별 데이터 분류-by Grouped as Floor @ Int. Finish
code_block_137 = CodeBlock { ",,"; }
list_create = List.Create(item0=IF_2, item1=IF_3, item2=IF_4, item3=IF_5)
transpose_10 = List.Transpose(lists=list_create)
join_6 = String.Join(separator=code_block_137, string0=transpose_10)
flatten_5 = List.Flatten(list=join_6)
chop_7 = List.Chop(list=flatten_5, lengths=code_block_136)

# group: 속성별 데이터 분류-by Grouped as Floor @ Roof. Finish
code_block_138 = CodeBlock { ".."; }
code_block_139 = CodeBlock(input=byKeysValues) { input; }
code_block_140 = CodeBlock(i=code_block_139) { i["data_nondic"]; }
code_block_141 = CodeBlock(i=code_block_139) { i["header"]; }
code_block_142 = CodeBlock { "Roof."; }
contains_12 = String.Contains(string=code_block_141, searchFor=code_block_142)
code_block_143 = CodeBlock { true; }
allIndicesOf_13 = List.AllIndicesOf(list=contains_12, item=code_block_143)
getItemAtIndex_24 = List.GetItemAtIndex(list=code_block_140, index=allIndicesOf_13)
code_block_144 = CodeBlock { "N/A"; }
isNull_6 = Object.IsNull()  # unwired: object
replaceByCondition_6 = Replace(item=getItemAtIndex_24, replaceWith=code_block_144, condition=isNull_6)
transpose_11 = List.Transpose(lists=replaceByCondition_6)
join_7 = String.Join(separator=code_block_138, string0=transpose_11@L2)

# group: string 검사
code_block_145 = CodeBlock(input=join_7) { input; }
code_block_146 = CodeBlock { ".."; }
endsWith_5 = String.EndsWith(string=code_block_145, searchFor=code_block_146)
code_block_147 = CodeBlock { -1; }
code_block_148 = CodeBlock { -2; }
remove_5 = String.Remove(string=code_block_145, startIndex=code_block_147, count=code_block_148)
IF_6 = Python(IN[0]=endsWith_5, IN[1]=remove_5, IN[2]=code_block_145)  # CPython3; same code as IF

# group: 속성별 데이터 분류-by Grouped as Floor @ Ext. Finish
code_block_149 = CodeBlock { ".."; }
code_block_150 = CodeBlock(input=byKeysValues) { input; }
code_block_151 = CodeBlock(i=code_block_150) { i["data_nondic"]; }
code_block_152 = CodeBlock(i=code_block_150) { i["header"]; }
code_block_153 = CodeBlock { "Ext."; }
contains_13 = String.Contains(string=code_block_152, searchFor=code_block_153)
code_block_154 = CodeBlock { true; }
allIndicesOf_14 = List.AllIndicesOf(list=contains_13, item=code_block_154)
getItemAtIndex_25 = List.GetItemAtIndex(list=code_block_151, index=allIndicesOf_14)
code_block_155 = CodeBlock { "N/A"; }
isNull_7 = Object.IsNull()  # unwired: object
replaceByCondition_7 = Replace(item=getItemAtIndex_25, replaceWith=code_block_155, condition=isNull_7)
transpose_12 = List.Transpose(lists=replaceByCondition_7)
join_8 = String.Join(separator=code_block_149, string0=transpose_12@L2)

# group: string 검사
code_block_156 = CodeBlock(input=join_8) { input; }
code_block_157 = CodeBlock { ".."; }
endsWith_6 = String.EndsWith(string=code_block_156, searchFor=code_block_157)
code_block_158 = CodeBlock { -1; }
code_block_159 = CodeBlock { -2; }
remove_6 = String.Remove(string=code_block_156, startIndex=code_block_158, count=code_block_159)
IF_7 = Python(IN[0]=endsWith_6, IN[1]=remove_6, IN[2]=code_block_156)  # CPython3; same code as IF

code_block_160 = CodeBlock(i=code_block_139) { i["countByFloor"]; }

# group: 속성별 데이터 분류-by Grouped as Floor @ Ext. Finish
code_block_161 = CodeBlock { ",,"; }
list_create_2 = List.Create(item0=IF_6, item1=IF_7)
transpose_13 = List.Transpose(lists=list_create_2)
join_9 = String.Join(separator=code_block_161, string0=transpose_13)
flatten_6 = List.Flatten(list=join_9)
chop_8 = List.Chop(list=flatten_6, lengths=code_block_160)

# group: 속성별 데이터 분류-by Grouped as Floor @ Dicipline
code_block_162 = CodeBlock(input=byKeysValues) { input; }
code_block_163 = CodeBlock(i=code_block_162) { i["data"]; }
code_block_164 = CodeBlock(i=code_block_162) { i["header"]; }
integer_slider_11 = IntegerSlider(-8, range=-8..70 step 1)
code_block_165 = CodeBlock(i=code_block_164, j=integer_slider_11) { i[j]; }
watch_10 = Watch(code_block_165)
valueAtKey_10 = DesignScript.Builtin.Dictionary.ValueAtKey(dictionary=code_block_163, key=watch_10)
code_block_166 = CodeBlock(i=code_block_162) { i["countByFloor"]; }
chop_9 = List.Chop(list=valueAtKey_10, lengths=code_block_166)
string_from_object_8 = FromObject(object=chop_9)
dicipline_2 = CodeBlock(result=string_from_object_8) { result; }

# group: 속성별 데이터 분류-by Grouped as Floor @ Room Name
code_block_167 = CodeBlock(input=byKeysValues) { input; }
code_block_168 = CodeBlock(i=code_block_167) { i["data"]; }
code_block_169 = CodeBlock(i=code_block_167) { i["header"]; }
integer_slider_12 = IntegerSlider(8, range=0..70 step 1)
code_block_170 = CodeBlock(i=code_block_169, j=integer_slider_12) { i[j]; }
watch_11 = Watch(code_block_170)
valueAtKey_11 = DesignScript.Builtin.Dictionary.ValueAtKey(dictionary=code_block_168, key=watch_11)
code_block_171 = CodeBlock(i=code_block_167) { i["countByFloor"]; }
chop_10 = List.Chop(list=valueAtKey_11, lengths=code_block_171)
room_name = CodeBlock(result=chop_10) { result; }

keys = DesignScript.Builtin.Dictionary.Keys(dictionary=createDictionary)
uniqueItems = List.UniqueItems(list=valueAtKey_2)

# group: 속성별 데이터 분류-by Grouped as Floor @ ceiling height
code_block_172 = CodeBlock(input=byKeysValues) { input; }
code_block_173 = CodeBlock(i=code_block_172) { i["data"]; }
code_block_174 = CodeBlock(i=code_block_172) { i["header"]; }
integer_slider_13 = IntegerSlider(12, range=0..70 step 1)
code_block_175 = CodeBlock(i=code_block_174, j=integer_slider_13) { i[j]; }
watch_12 = Watch(code_block_175)
valueAtKey_12 = DesignScript.Builtin.Dictionary.ValueAtKey(dictionary=code_block_173, key=watch_12)
code_block_176 = CodeBlock(i=code_block_172) { i["countByFloor"]; }
chop_11 = List.Chop(list=valueAtKey_12, lengths=code_block_176)
code_block_177 = CodeBlock { 0; }
isNull_8 = Object.IsNull()  # unwired: object
replaceByCondition_8 = Replace(item=chop_11, replaceWith=code_block_177, condition=isNull_8)
height_2 = CodeBlock(result=replaceByCondition_8) { result*1000; }

# group: PARAMETERS & COLOR: Setting the parameter values in the space planning families. Changing color of each family instance by associated Department.
code_block_178 = CodeBlock { "Width"; }
setParameterByName = Element.SetParameterByName(element=byPointAndLevel, parameterName=code_block_178, value=length)
code_block_179 = CodeBlock { "Length"; }
setParameterByName_2 = Element.SetParameterByName(element=byPointAndLevel, parameterName=code_block_179, value=length_2)
code_block_180 = CodeBlock { "Program Area"; }
setParameterByName_3 = Element.SetParameterByName(element=byPointAndLevel, parameterName=code_block_180, value=area)
code_block_181 = CodeBlock { "Height"; }
setParameterByName_4 = Element.SetParameterByName(element=byPointAndLevel, parameterName=code_block_181, value=height)
flatten_7 = List.Flatten(list=byPointAndLevel)
code_block_182 = CodeBlock { "Fill Color"; }
# note: This list assigns a name to the RGB
# color values in the Code Block below.
# These color names also correspond to
# the colors from the COLOR column in
# the Excel spreadsheet.
flatten_8 = List.Flatten(list=dicipline)
byName = Material.ByName(name=flatten_8)
# note: this node colorizes each box
# according to the Deparment
# list by replacing the material
# ("Fill Color")
setParameterByName_5 = Element.SetParameterByName(element=flatten_7, parameterName=code_block_182, value=byName)
code_block_183 = CodeBlock { "Interior Finish"; }
setParameterByName_6 = Element.SetParameterByName(element=byPointAndLevel, parameterName=code_block_183, value=chop_7)
code_block_184 = CodeBlock { "Exterior Finish"; }
setParameterByName_7 = Element.SetParameterByName(element=byPointAndLevel, parameterName=code_block_184, value=chop_8)
code_block_185 = CodeBlock { "Department"; }
# note: this series of nodes assigns
# the selected sublists to certain
# parameters in the space planning
# family
setParameterByName_8 = Element.SetParameterByName(element=byPointAndLevel, parameterName=code_block_185, value=dicipline_2)
code_block_186 = CodeBlock { "Room Name"; }
setParameterByName_9 = Element.SetParameterByName(element=byPointAndLevel, parameterName=code_block_186, value=room_name)
code_block_187 = CodeBlock { "Elevation from Level"; 0; }
setParameterByName_10 = Element.SetParameterByName(element=byPointAndLevel, parameterName=code_block_187.out0, value=code_block_187.out1)
code_block_188 = CodeBlock { "ceiling height"; }
setParameterByName_11 = Element.SetParameterByName(element=byPointAndLevel, parameterName=code_block_188, value=height_2)
