# Dynamo graph 1b_Mass_parameter_rematch (by Building List)(220623).dyn "1b_Mass_parameter_rematch (by Building List)(1218)" (Dynamo 2.12.0.5650)

# group: Data 전처리 구간

# group: Excel Import 구간

# group: Input_Excel related
file_path = Filename(".\01_Building List_Pilot Project_2022_0218.xlsx")  # graph input
sheet_name = StringInput("Building List")  # graph input

# group: Github_Python@Import Excel(By OpenpyXl)
string_from_web = Python()  # CPython3; unwired: IN[0]
# ---------- string_from_web.python (19 lines) ----------
# Load the Python Standard and DesignScript Libraries
import sys
import clr
clr.AddReference('ProtoGeometry')
from Autodesk.DesignScript.Geometry import *
import urllib.request

# The inputs to this node will be stored as a list in the IN variables.
dataEnteringNode = IN
inputURL = "https://raw.githubusercontent.com/HNANmal/mQ/master/Hdynlib/General/ImportExcel.py"

# Place your code below this line
req = urllib.request
data = req.urlopen(inputURL)

result = data.read().decode("utf-8")

# Assign your output to the OUT variable.
OUT = result
# ----------------------------------------
python_script_from_string = PythonStringNode(script=string_from_web, IN[0]=file_path, IN[1]=sheet_name)  # CPython3

# group: 절대좌표 바깥쪽 불필요 데이터 제거
firstItem = List.FirstItem(list=python_script_from_string)
string_from_object = FromObject(object=firstItem)
code_block = CodeBlock { "null"; }
allIndicesOf = List.AllIndicesOf(list=string_from_object, item=code_block)
removeItemAtIndex = List.RemoveItemAtIndex(list=python_script_from_string@L2, indices=allIndicesOf)

headerRowIdx = DoubleInput(3)  # graph input

# group: 시트 헤더 분리 및 필요 칼럼 인덱스 추출
code_block_2 = CodeBlock(i=headerRowIdx) { i; }
getItemAtIndex = List.GetItemAtIndex(list=removeItemAtIndex, index=code_block_2)
string_from_object_2 = FromObject(object=getItemAtIndex)
code_block_3 = CodeBlock { "_"; }
startsWith = String.StartsWith(string=string_from_object_2, searchFor=code_block_3)
code_block_4 = CodeBlock { false; }
allIndicesOf_2 = List.AllIndicesOf(list=startsWith, item=code_block_4)
getItemAtIndex_2 = List.GetItemAtIndex(list=getItemAtIndex, index=allIndicesOf_2)

# group: 시트 타이틀 및 헤더 제거 및 불필요 칼럼 제거
code_block_5 = CodeBlock(i=headerRowIdx) { 1..i; }
removeItemAtIndex_2 = List.RemoveItemAtIndex(list=removeItemAtIndex, indices=code_block_5)
getItemAtIndex_3 = List.GetItemAtIndex(list=removeItemAtIndex_2@L2, index=allIndicesOf_2)

# group: 절대좌표와 Building Name 칼럼 추출
transpose = List.Transpose(lists=getItemAtIndex_3)
code_block_6 = CodeBlock { "Building Name"; }
firstIndexOf = List.FirstIndexOf(list=getItemAtIndex_2, item=code_block_6)
code_block_7 = CodeBlock(i=firstIndexOf)
# ---------- code_block_7.designscript (3 lines) ----------
[0,i];
//index[0]은 절대좌표
//index[i]은 Building Name
# ----------------------------------------
getItemAtIndex_4 = List.GetItemAtIndex(list=transpose, index=code_block_7)

# group: 건물별 분리기준 행 추출
string_from_object_3 = FromObject(object=getItemAtIndex_4)
lastItem = List.LastItem(list=string_from_object_3)

# group: 건물별 분리
code_block_8 = CodeBlock { 0; "null"; }
replaceItemAtIndex = List.ReplaceItemAtIndex(list=lastItem, index=code_block_8.out0, item=code_block_8.out1)
code_block_9 = CodeBlock(i=replaceItemAtIndex) { i != "null"; true; }
allIndicesOf_3 = List.AllIndicesOf(list=code_block_9.out0, item=code_block_9.out1)
전체_데이터_by_row = CodeBlock(i=transpose) { i; }
절대좌표_by_row = CodeBlock(i=전체_데이터_by_row) { i[0]; }
count = List.Count(list=절대좌표_by_row)
join = List.Join(list0=allIndicesOf_3, list1=count)
index_finder_건물별_row = Python(IN[0]=join)  # CPython3
# ---------- index_finder_건물별_row.python (22 lines) ----------
# Load the Python Standard and DesignScript Libraries
import sys
import clr
clr.AddReference('ProtoGeometry')
from Autodesk.DesignScript.Geometry import *

# The inputs to this node will be stored as a list in the IN variables.
dataEnteringNode = IN

inputIndex = IN[0]
# Place your code below this line
result = []

for i in range(len(inputIndex)):
    if i+1 < len(inputIndex):
        result.append(range(inputIndex[i], inputIndex[i+1]))
    else:
        pass


# Assign your output to the OUT variable.
OUT = result
# ----------------------------------------
getItemAtIndex_5 = List.GetItemAtIndex(list=transpose@L2, index=index_finder_건물별_row@L2, lacing=CrossProduct)
transpose_2 = List.Transpose(lists=getItemAtIndex_5)

# group: 건물선택
건물선택 = StringInput("Central")  # graph input

# group: 건물선택
건물별_그룹데이터_by_column = CodeBlock(i=transpose_2) { i; }
code_block_10 = CodeBlock { 3; }
getItemAtIndex_6 = List.GetItemAtIndex(list=건물별_그룹데이터_by_column@L3, index=code_block_10)
firstItem_2 = List.FirstItem(list=getItemAtIndex_6@L2)
contains = String.Contains(string=firstItem_2, searchFor=건물선택)
code_block_11 = CodeBlock { true; }
firstIndexOf_2 = List.FirstIndexOf(list=contains, item=code_block_11)
getItemAtIndex_7 = List.GetItemAtIndex(list=건물별_그룹데이터_by_column, index=firstIndexOf_2)

# group: 불필요 Row 제거
시트_헤더 = CodeBlock(i=getItemAtIndex_2) { i; }
string_from_object_4 = FromObject(object=시트_헤더)
code_block_12 = CodeBlock { "Room Name"; }
contains_2 = String.Contains(string=string_from_object_4, searchFor=code_block_12)
code_block_13 = CodeBlock { true; }
firstIndexOf_3 = List.FirstIndexOf(list=contains_2, item=code_block_13)
getItemAtIndex_8 = List.GetItemAtIndex(list=getItemAtIndex_7, index=firstIndexOf_3)
string_from_object_5 = FromObject(object=getItemAtIndex_8)
code_block_14 = CodeBlock(i=string_from_object_5) { i=="null"?false:true; true; }
allIndicesOf_4 = List.AllIndicesOf(list=code_block_14.out0, item=code_block_14.out1)
getItemAtIndex_9 = List.GetItemAtIndex(list=getItemAtIndex_7@L2, index=allIndicesOf_4)

# group: header별 데이터 딕셔너리 형성
시트_헤더_2 = CodeBlock(i=getItemAtIndex_2) { i; }
code_block_15 = CodeBlock { 1; }
list_dropitems_절대좌표제거 = List.DropItems(list=시트_헤더_2, amount=code_block_15)
string_from_object_6 = FromObject(object=list_dropitems_절대좌표제거)
code_block_16 = CodeBlock { 1; }
list_dropitems_절대좌표제거_2 = List.DropItems(list=getItemAtIndex_9, amount=code_block_16)
python_script = Python(IN[0]=string_from_object_6, IN[1]=list_dropitems_절대좌표제거_2)  # CPython3
# ---------- python_script.python (22 lines) ----------
# Load the Python Standard and DesignScript Libraries
import sys
import clr
clr.AddReference('ProtoGeometry')
from Autodesk.DesignScript.Geometry import *

# The inputs to this node will be stored as a list in the IN variables.
dataEnteringNode = IN

inputKeys = IN[0]
inputValues = IN[1]

# Place your code below this line

dict = {}
for i in range(len(inputKeys)):
    dict[inputKeys[i]] = inputValues[i]
    
result = dict

# Assign your output to the OUT variable.
OUT = result
# ----------------------------------------

keys = DesignScript.Builtin.Dictionary.Keys(dictionary=python_script)
family_types = FamilyTypes("Space Planning Box_hec:Space Planning Box_hec")  # graph input
code_block_17 = CodeBlock(header=string_from_object_6, data=python_script, data_nondic=list_dropitems_절대좌표제거_2)
# ---------- code_block_17.designscript (5 lines) ----------
{
"header": _header,
"data": _data,
"data_nondic": _data_nondic
};
# ----------------------------------------

# group: 층별 갯수 계산
code_block_18 = CodeBlock { "countByFloor"; }
code_block_19 = CodeBlock(input=code_block_17) { input; }
components = DesignScript.Builtin.Dictionary.Components(dictionary=code_block_19)
addItemToEnd = List.AddItemToEnd(item=code_block_18, list=components.keys)
code_block_20 = CodeBlock(i=code_block_19) { i["data"]; }
code_block_21 = CodeBlock(i=code_block_19) { i["header"]; }
integer_slider = IntegerSlider(6, range=0..70 step 1)
code_block_22 = CodeBlock(i=code_block_21, j=integer_slider) { i[j]; }
watch = Watch(code_block_22)
valueAtKey = DesignScript.Builtin.Dictionary.ValueAtKey(dictionary=code_block_20, key=watch)
층별_갯수_계산 = CodeBlock(i=valueAtKey) { j = List.UniqueItems(i); blnlist = i==j<1>; List.CountTrue(blnlist<1>); }
addItemToEnd_2 = List.AddItemToEnd(item=층별_갯수_계산.out2, list=components.values)
byKeysValues = DesignScript.Builtin.Dictionary.ByKeysValues(keys=addItemToEnd, values=addItemToEnd_2)

# group: 속성별 데이터 분류-by Grouped as Floor @ Room Name
code_block_23 = CodeBlock(input=byKeysValues) { input; }
code_block_24 = CodeBlock(i=code_block_23) { i["data"]; }
code_block_25 = CodeBlock(i=code_block_23) { i["header"]; }
integer_slider_2 = IntegerSlider(8, range=0..70 step 1)
code_block_26 = CodeBlock(i=code_block_25, j=integer_slider_2) { i[j]; }
watch_2 = Watch(code_block_26)
valueAtKey_2 = DesignScript.Builtin.Dictionary.ValueAtKey(dictionary=code_block_24, key=watch_2)
code_block_27 = CodeBlock(i=code_block_23) { i["countByFloor"]; }
chop = List.Chop(list=valueAtKey_2, lengths=code_block_27)
room_name = CodeBlock(result=chop) { result; }

# group: 속성별 데이터 분류-by Grouped as Floor @ Dicipline
code_block_28 = CodeBlock(input=byKeysValues) { input; }
code_block_29 = CodeBlock(i=code_block_28) { i["data"]; }
code_block_30 = CodeBlock(i=code_block_28) { i["header"]; }
integer_slider_3 = IntegerSlider(-8, range=-8..70 step 1)
code_block_31 = CodeBlock(i=code_block_30, j=integer_slider_3) { i[j]; }
watch_3 = Watch(code_block_31)
valueAtKey_3 = DesignScript.Builtin.Dictionary.ValueAtKey(dictionary=code_block_29, key=watch_3)
code_block_32 = CodeBlock(i=code_block_28) { i["countByFloor"]; }
chop_2 = List.Chop(list=valueAtKey_3, lengths=code_block_32)
string_from_object_7 = FromObject(object=chop_2)
dicipline = CodeBlock(result=string_from_object_7) { result; }

# group: 속성별 데이터 분류-by Grouped as Floor @ Area
code_block_33 = CodeBlock(input=byKeysValues) { input; }
code_block_34 = CodeBlock(i=code_block_33) { i["data"]; }
code_block_35 = CodeBlock(i=code_block_33) { i["header"]; }
integer_slider_4 = IntegerSlider(14, range=0..70 step 1)
code_block_36 = CodeBlock(i=code_block_35, j=integer_slider_4) { i[j]; }
watch_4 = Watch(code_block_36)
valueAtKey_4 = DesignScript.Builtin.Dictionary.ValueAtKey(dictionary=code_block_34, key=watch_4)
code_block_37 = CodeBlock(i=code_block_33) { i["countByFloor"]; }
chop_3 = List.Chop(list=valueAtKey_4, lengths=code_block_37)
code_block_38 = CodeBlock { 0; }
isNull = Object.IsNull()  # unwired: object
replaceByCondition = Replace(item=chop_3, replaceWith=code_block_38, condition=isNull)
area = CodeBlock(result=replaceByCondition) { result; }

# group: 속성별 데이터 분류-by Grouped as Floor @ Height
code_block_39 = CodeBlock(input=byKeysValues) { input; }
code_block_40 = CodeBlock(i=code_block_39) { i["data"]; }
code_block_41 = CodeBlock(i=code_block_39) { i["header"]; }
integer_slider_5 = IntegerSlider(11, range=0..70 step 1)
code_block_42 = CodeBlock(i=code_block_41, j=integer_slider_5) { i[j]; }
watch_5 = Watch(code_block_42)
valueAtKey_5 = DesignScript.Builtin.Dictionary.ValueAtKey(dictionary=code_block_40, key=watch_5)
code_block_43 = CodeBlock(i=code_block_39) { i["countByFloor"]; }
chop_4 = List.Chop(list=valueAtKey_5, lengths=code_block_43)
height = CodeBlock(result=chop_4) { result*1000; }

# group: 속성별 데이터 분류-by Grouped as Floor @ Ceiling Height
code_block_44 = CodeBlock(input=byKeysValues) { input; }
code_block_45 = CodeBlock(i=code_block_44) { i["data"]; }
code_block_46 = CodeBlock(i=code_block_44) { i["header"]; }
integer_slider_6 = IntegerSlider(12, range=-6..70 step 1)
code_block_47 = CodeBlock(i=code_block_46, j=integer_slider_6) { i[j]; }
watch_6 = Watch(code_block_47)
valueAtKey_6 = DesignScript.Builtin.Dictionary.ValueAtKey(dictionary=code_block_45, key=watch_6)
code_block_48 = CodeBlock(i=code_block_44) { i["countByFloor"]; }
chop_5 = List.Chop(list=valueAtKey_6, lengths=code_block_48)
code_block_49 = CodeBlock { 0; }
isNull_2 = Object.IsNull()  # unwired: object
replaceByCondition_2 = Replace(item=chop_5, replaceWith=code_block_49, condition=isNull_2)
dicipline_2 = CodeBlock(result=replaceByCondition_2) { result*1000; }

# group: 속성별 데이터 분류-by Grouped as Floor @ Length
code_block_50 = CodeBlock(input=byKeysValues) { input; }
code_block_51 = CodeBlock(i=code_block_50) { i["data"]; }
code_block_52 = CodeBlock(i=code_block_50) { i["header"]; }
integer_slider_7 = IntegerSlider(10, range=0..70 step 1)
code_block_53 = CodeBlock(i=code_block_52, j=integer_slider_7) { i[j]; }
watch_7 = Watch(code_block_53)
valueAtKey_7 = DesignScript.Builtin.Dictionary.ValueAtKey(dictionary=code_block_51, key=watch_7)
code_block_54 = CodeBlock(i=code_block_50) { i["countByFloor"]; }
chop_6 = List.Chop(list=valueAtKey_7, lengths=code_block_54)
length = CodeBlock(result=chop_6) { result*1000; }

# group: 속성별 데이터 분류-by Grouped as Floor @ Width
code_block_55 = CodeBlock(input=byKeysValues) { input; }
code_block_56 = CodeBlock(i=code_block_55) { i["data"]; }
code_block_57 = CodeBlock(i=code_block_55) { i["header"]; }
integer_slider_8 = IntegerSlider(9, range=0..70 step 1)
code_block_58 = CodeBlock(i=code_block_57, j=integer_slider_8) { i[j]; }
watch_8 = Watch(code_block_58)
valueAtKey_8 = DesignScript.Builtin.Dictionary.ValueAtKey(dictionary=code_block_56, key=watch_8)
code_block_59 = CodeBlock(i=code_block_55) { i["countByFloor"]; }
chop_7 = List.Chop(list=valueAtKey_8, lengths=code_block_59)
length_2 = CodeBlock(result=chop_7) { result*1000; }

# group: 속성별 데이터 분류-by Grouped as Floor @ Roof. Finish
code_block_60 = CodeBlock { ".."; }
code_block_61 = CodeBlock(input=byKeysValues) { input; }
code_block_62 = CodeBlock(i=code_block_61) { i["data_nondic"]; }
code_block_63 = CodeBlock(i=code_block_61) { i["header"]; }
code_block_64 = CodeBlock { "Roof."; }
contains_3 = String.Contains(string=code_block_63, searchFor=code_block_64)
code_block_65 = CodeBlock { true; }
allIndicesOf_5 = List.AllIndicesOf(list=contains_3, item=code_block_65)
getItemAtIndex_10 = List.GetItemAtIndex(list=code_block_62, index=allIndicesOf_5)
code_block_66 = CodeBlock { "N/A"; }
isNull_3 = Object.IsNull()  # unwired: object
replaceByCondition_3 = Replace(item=getItemAtIndex_10, replaceWith=code_block_66, condition=isNull_3)
transpose_3 = List.Transpose(lists=replaceByCondition_3)
join_2 = String.Join(separator=code_block_60, string0=transpose_3@L2)

# group: string 검사
code_block_67 = CodeBlock(input=join_2) { input; }
code_block_68 = CodeBlock { ".."; }
endsWith = String.EndsWith(string=code_block_67, searchFor=code_block_68)
code_block_69 = CodeBlock { -1; }
code_block_70 = CodeBlock { -2; }
remove = String.Remove(string=code_block_67, startIndex=code_block_69, count=code_block_70)
IF = Python(IN[0]=endsWith, IN[1]=remove, IN[2]=code_block_67)  # CPython3
# ---------- IF.python (45 lines) ----------
# Load the Python Standard and DesignScript Libraries
import sys
import clr
clr.AddReference('ProtoGeometry')
from Autodesk.DesignScript.Geometry import *

# The inputs to this node will be stored as a list in the IN variables.
dataEnteringNode = IN

# Place your code below this line
def chk_CountOfBlns(_blns):
    
    if isinstance(_blns, list):
        return True
    else:
        return False

def TestForLists(_args):
    blns = _args[0]
    
    def unitTest(_argsSet):
        (testBln, resTrue, resFalse) = _argsSet
        
        if testBln:
            return resTrue
        else:
            return resFalse
    
    def wholeTest(_args):
        if _args[0]:
            return _args[1]
        else:
            return _args[2]
    
    if chk_CountOfBlns(blns):
        _argsSets = list(zip(*IN))
        res = map(unitTest, _argsSets)
    else:
        res = wholeTest(_args)
        
    return res


# Assign your output to the OUT variable.
OUT = TestForLists(IN)
# ----------------------------------------

# group: 속성별 데이터 분류-by Grouped as Floor @ Ext. Finish
code_block_71 = CodeBlock { ".."; }
code_block_72 = CodeBlock(input=byKeysValues) { input; }
code_block_73 = CodeBlock(i=code_block_72) { i["data_nondic"]; }
code_block_74 = CodeBlock(i=code_block_72) { i["header"]; }
code_block_75 = CodeBlock { "Ext."; }
contains_4 = String.Contains(string=code_block_74, searchFor=code_block_75)
code_block_76 = CodeBlock { true; }
allIndicesOf_6 = List.AllIndicesOf(list=contains_4, item=code_block_76)
getItemAtIndex_11 = List.GetItemAtIndex(list=code_block_73, index=allIndicesOf_6)
code_block_77 = CodeBlock { "N/A"; }
isNull_4 = Object.IsNull()  # unwired: object
replaceByCondition_4 = Replace(item=getItemAtIndex_11, replaceWith=code_block_77, condition=isNull_4)
transpose_4 = List.Transpose(lists=replaceByCondition_4)
join_3 = String.Join(separator=code_block_71, string0=transpose_4@L2)

# group: string 검사
code_block_78 = CodeBlock(input=join_3) { input; }
code_block_79 = CodeBlock { ".."; }
endsWith_2 = String.EndsWith(string=code_block_78, searchFor=code_block_79)
code_block_80 = CodeBlock { -1; }
code_block_81 = CodeBlock { -2; }
remove_2 = String.Remove(string=code_block_78, startIndex=code_block_80, count=code_block_81)
IF_2 = Python(IN[0]=endsWith_2, IN[1]=remove_2, IN[2]=code_block_78)  # CPython3; same code as IF

code_block_82 = CodeBlock(i=code_block_61) { i["countByFloor"]; }

# group: 속성별 데이터 분류-by Grouped as Floor @ Ext. Finish
code_block_83 = CodeBlock { ",,"; }
list_create = List.Create(item0=IF, item1=IF_2)
transpose_5 = List.Transpose(lists=list_create)
join_4 = String.Join(separator=code_block_83, string0=transpose_5)
flatten = List.Flatten(list=join_4)
chop_8 = List.Chop(list=flatten, lengths=code_block_82)

# group: 속성별 데이터 분류-by Grouped as Floor @ Int. Wall Finish
code_block_84 = CodeBlock { ".."; }
code_block_85 = CodeBlock(input=byKeysValues) { input; }
code_block_86 = CodeBlock(i=code_block_85) { i["data_nondic"]; }
code_block_87 = CodeBlock(i=code_block_85) { i["header"]; }
code_block_88 = CodeBlock { "Int."; }
contains_5 = String.Contains(string=code_block_87, searchFor=code_block_88)
code_block_89 = CodeBlock { true; }
allIndicesOf_7 = List.AllIndicesOf(list=contains_5, item=code_block_89)
getItemAtIndex_12 = List.GetItemAtIndex(list=code_block_86, index=allIndicesOf_7)
getItemAtIndex_13 = List.GetItemAtIndex(list=code_block_87, index=allIndicesOf_7)
code_block_90 = CodeBlock { "Wall"; }
contains_6 = String.Contains(string=getItemAtIndex_13, searchFor=code_block_90)
code_block_91 = CodeBlock { true; }
allIndicesOf_8 = List.AllIndicesOf(list=contains_6, item=code_block_91)
getItemAtIndex_14 = List.GetItemAtIndex(list=getItemAtIndex_12, index=allIndicesOf_8)
code_block_92 = CodeBlock { "N/A"; }
isNull_5 = Object.IsNull()  # unwired: object
replaceByCondition_5 = Replace(item=getItemAtIndex_14, replaceWith=code_block_92, condition=isNull_5)
transpose_6 = List.Transpose(lists=replaceByCondition_5)
join_5 = String.Join(separator=code_block_84, string0=transpose_6@L2)

# group: string 검사
code_block_93 = CodeBlock(input=join_5) { input; }
code_block_94 = CodeBlock { ".."; }
endsWith_3 = String.EndsWith(string=code_block_93, searchFor=code_block_94)
code_block_95 = CodeBlock { -1; }
code_block_96 = CodeBlock { -2; }
remove_3 = String.Remove(string=code_block_93, startIndex=code_block_95, count=code_block_96)
IF_3 = Python(IN[0]=endsWith_3, IN[1]=remove_3, IN[2]=code_block_93)  # CPython3; same code as IF

# group: 속성별 데이터 분류-by Grouped as Floor @ Int. Base Finish
code_block_97 = CodeBlock { ".."; }
code_block_98 = CodeBlock(input=byKeysValues) { input; }
code_block_99 = CodeBlock(i=code_block_98) { i["data_nondic"]; }
code_block_100 = CodeBlock(i=code_block_98) { i["header"]; }
code_block_101 = CodeBlock { "Int."; }
contains_7 = String.Contains(string=code_block_100, searchFor=code_block_101)
code_block_102 = CodeBlock { true; }
allIndicesOf_9 = List.AllIndicesOf(list=contains_7, item=code_block_102)
getItemAtIndex_15 = List.GetItemAtIndex(list=code_block_99, index=allIndicesOf_9)
getItemAtIndex_16 = List.GetItemAtIndex(list=code_block_100, index=allIndicesOf_9)
code_block_103 = CodeBlock { "Base"; }
contains_8 = String.Contains(string=getItemAtIndex_16, searchFor=code_block_103)
code_block_104 = CodeBlock { true; }
allIndicesOf_10 = List.AllIndicesOf(list=contains_8, item=code_block_104)
getItemAtIndex_17 = List.GetItemAtIndex(list=getItemAtIndex_15, index=allIndicesOf_10)
code_block_105 = CodeBlock { "N/A"; }
isNull_6 = Object.IsNull()  # unwired: object
replaceByCondition_6 = Replace(item=getItemAtIndex_17, replaceWith=code_block_105, condition=isNull_6)
transpose_7 = List.Transpose(lists=replaceByCondition_6)
join_6 = String.Join(separator=code_block_97, string0=transpose_7@L2)

# group: string 검사
code_block_106 = CodeBlock(input=join_6) { input; }
code_block_107 = CodeBlock { ".."; }
endsWith_4 = String.EndsWith(string=code_block_106, searchFor=code_block_107)
code_block_108 = CodeBlock { -1; }
code_block_109 = CodeBlock { -2; }
remove_4 = String.Remove(string=code_block_106, startIndex=code_block_108, count=code_block_109)
IF_4 = Python(IN[0]=endsWith_4, IN[1]=remove_4, IN[2]=code_block_106)  # CPython3; same code as IF

# group: 속성별 데이터 분류-by Grouped as Floor @ Int. Floor Finish
code_block_110 = CodeBlock { ".."; }
code_block_111 = CodeBlock(input=byKeysValues) { input; }
code_block_112 = CodeBlock(i=code_block_111) { i["data_nondic"]; }
code_block_113 = CodeBlock(i=code_block_111) { i["header"]; }
code_block_114 = CodeBlock { "Int."; }
contains_9 = String.Contains(string=code_block_113, searchFor=code_block_114)
code_block_115 = CodeBlock { true; }
allIndicesOf_11 = List.AllIndicesOf(list=contains_9, item=code_block_115)
getItemAtIndex_18 = List.GetItemAtIndex(list=code_block_112, index=allIndicesOf_11)
getItemAtIndex_19 = List.GetItemAtIndex(list=code_block_113, index=allIndicesOf_11)
code_block_116 = CodeBlock { "Floor"; }
contains_10 = String.Contains(string=getItemAtIndex_19, searchFor=code_block_116)
code_block_117 = CodeBlock { true; }
allIndicesOf_12 = List.AllIndicesOf(list=contains_10, item=code_block_117)
getItemAtIndex_20 = List.GetItemAtIndex(list=getItemAtIndex_18, index=allIndicesOf_12)
code_block_118 = CodeBlock { "N/A"; }
isNull_7 = Object.IsNull()  # unwired: object
replaceByCondition_7 = Replace(item=getItemAtIndex_20, replaceWith=code_block_118, condition=isNull_7)
transpose_8 = List.Transpose(lists=replaceByCondition_7)
join_7 = String.Join(separator=code_block_110, string0=transpose_8@L2)

# group: string 검사
code_block_119 = CodeBlock(input=join_7) { input; }
code_block_120 = CodeBlock { ".."; }
endsWith_5 = String.EndsWith(string=code_block_119, searchFor=code_block_120)
code_block_121 = CodeBlock { -1; }
code_block_122 = CodeBlock { -2; }
remove_5 = String.Remove(string=code_block_119, startIndex=code_block_121, count=code_block_122)
IF_5 = Python(IN[0]=endsWith_5, IN[1]=remove_5, IN[2]=code_block_119)  # CPython3; same code as IF

# group: 속성별 데이터 분류-by Grouped as Floor @ Int. Ceiling Finish
code_block_123 = CodeBlock { ".."; }
code_block_124 = CodeBlock(input=byKeysValues) { input; }
code_block_125 = CodeBlock(i=code_block_124) { i["data_nondic"]; }
code_block_126 = CodeBlock(i=code_block_124) { i["header"]; }
code_block_127 = CodeBlock { "Int."; }
contains_11 = String.Contains(string=code_block_126, searchFor=code_block_127)
code_block_128 = CodeBlock { true; }
allIndicesOf_13 = List.AllIndicesOf(list=contains_11, item=code_block_128)
getItemAtIndex_21 = List.GetItemAtIndex(list=code_block_125, index=allIndicesOf_13)
getItemAtIndex_22 = List.GetItemAtIndex(list=code_block_126, index=allIndicesOf_13)
code_block_129 = CodeBlock { "Ceiling"; }
contains_12 = String.Contains(string=getItemAtIndex_22, searchFor=code_block_129)
code_block_130 = CodeBlock { true; }
allIndicesOf_14 = List.AllIndicesOf(list=contains_12, item=code_block_130)
getItemAtIndex_23 = List.GetItemAtIndex(list=getItemAtIndex_21, index=allIndicesOf_14)
code_block_131 = CodeBlock { "N/A"; }
isNull_8 = Object.IsNull()  # unwired: object
replaceByCondition_8 = Replace(item=getItemAtIndex_23, replaceWith=code_block_131, condition=isNull_8)
transpose_9 = List.Transpose(lists=replaceByCondition_8)
join_8 = String.Join(separator=code_block_123, string0=transpose_9@L2)

# group: string 검사
code_block_132 = CodeBlock(input=join_8) { input; }
code_block_133 = CodeBlock { ".."; }
endsWith_6 = String.EndsWith(string=code_block_132, searchFor=code_block_133)
code_block_134 = CodeBlock { -1; }
code_block_135 = CodeBlock { -2; }
remove_6 = String.Remove(string=code_block_132, startIndex=code_block_134, count=code_block_135)
IF_6 = Python(IN[0]=endsWith_6, IN[1]=remove_6, IN[2]=code_block_132)  # CPython3; same code as IF

code_block_136 = CodeBlock(i=code_block_85) { i["countByFloor"]; }

# group: 속성별 데이터 분류-by Grouped as Floor @ Int. Finish
code_block_137 = CodeBlock { ",,"; }
list_create_2 = List.Create(item0=IF_3, item1=IF_4, item2=IF_5, item3=IF_6)
transpose_10 = List.Transpose(lists=list_create_2)
join_9 = String.Join(separator=code_block_137, string0=transpose_10)
flatten_2 = List.Flatten(list=join_9)
chop_9 = List.Chop(list=flatten_2, lengths=code_block_136)

# group: 속성별 데이터 분류-by Grouped as Floor @ Dicipline Colour
code_block_138 = CodeBlock(input=byKeysValues) { input; }
code_block_139 = CodeBlock(i=code_block_138) { i["data"]; }
code_block_140 = CodeBlock(i=code_block_138) { i["header"]; }
integer_slider_9 = IntegerSlider(-7, range=-7..70 step 1)
code_block_141 = CodeBlock(i=code_block_140, j=integer_slider_9) { i[j]; }
watch_9 = Watch(code_block_141)
valueAtKey_9 = DesignScript.Builtin.Dictionary.ValueAtKey(dictionary=code_block_139, key=watch_9)
code_block_142 = CodeBlock(i=code_block_138) { i["countByFloor"]; }
chop_10 = List.Chop(list=valueAtKey_9, lengths=code_block_142)
dicipline_3 = CodeBlock(result=chop_10) { result; }

# group: 사이즈 값 제외한 엑셀 데이터, 박스에 덮어쓰기
family_types_2 = CodeBlock(i=family_types) { i; }
all_elements_of_family_type = ElementsOfFamilyType(Family_Type=family_types_2)
code_block_143 = CodeBlock { "Level"; }
getParameterValueByName = Element.GetParameterValueByName(element=all_elements_of_family_type, parameterName=code_block_143)
string_from_object_8 = FromObject(object=getParameterValueByName)
uniqueItems = List.UniqueItems(list=string_from_object_8)
allIndicesOf_15 = List.AllIndicesOf(list=string_from_object_8, item=uniqueItems)
getItemAtIndex_24 = List.GetItemAtIndex(list=all_elements_of_family_type, index=allIndicesOf_15)
byName = Material.ByName(name=dicipline_3)
python_script_boxinfoclass = Python(IN[0]=room_name, IN[1]=dicipline, IN[2]=area, IN[3]=height, IN[4]=dicipline_2, IN[5]=length, IN[6]=length_2, IN[7]=chop_8, IN[8]=chop_9, IN[9]=byName)  # CPython3
# ---------- python_script_boxinfoclass.python (46 lines) ----------
# Load the Python Standard and DesignScript Libraries
import sys
import clr
clr.AddReference('ProtoGeometry')
from Autodesk.DesignScript.Geometry import *
from itertools import chain

# The inputs to this node will be stored as a list in the IN variables.
dataEnteringNode = IN

name = IN[0]
depart = IN[1]
area = IN[2]
height = IN[3]
ceilheight = IN[4]
length = IN[5]
width = IN[6]
ext_finish = IN[7]
int_finish = IN[8]
color = IN[9]
# Place your code below this line

class BoxInfo:
    def __init__(self, name, depart, area, height, ceilheight, length, width, ext_finish, int_finish, color):
        self.name = name
        self.depart = depart
        self.area = area
        self.height = height
        self.ceilheight = ceilheight
        self.length = length
        self.width = width
        self.ext_finish = ext_finish
        self.int_finish = int_finish
        self.color = color

result = []
for level in range(len(name)):
    tmp = []
    for i in range(len(name[level])):
        qbox = BoxInfo(name[level][i], depart[level][i], area[level][i], height[level][i], ceilheight[level][i], length[level][i], width[level][i], ext_finish[level][i], int_finish[level][i], color[level][i])
        tmp.append(qbox)
    result.append(tmp)
    

# Assign your output to the OUT variable.
OUT = result
# ----------------------------------------
python_script_boxinfoclass_2 = Python(IN[0]=getItemAtIndex_24, IN[1]=python_script_boxinfoclass)  # CPython3
# ---------- python_script_boxinfoclass_2.python (51 lines) ----------
# Load the Python Standard and DesignScript Libraries
import sys
import clr
clr.AddReference('ProtoGeometry')
from Autodesk.DesignScript.Geometry import *
from itertools import chain

import clr
clr.AddReference("RevitAPI")
from Autodesk.Revit.DB import *
clr.AddReference("RevitServices")
import RevitServices
from RevitServices.Persistence import DocumentManager
from RevitServices.Transactions import TransactionManager

doc = DocumentManager.Instance.CurrentDBDocument


# The inputs to this node will be stored as a list in the IN variables.
dataEnteringNode = IN

boxelemlist = IN[0]
boxinfolist = IN[1]
# Place your code below this line
box_paramlist = ["Room Name", "Department", "Program Area", "Height", "ceiling height", "Length", "Width", "Exterior Finish", "Interior Finish", "Fill Color"]

TransactionManager.Instance.EnsureInTransaction(doc)

result = []
for level in range(len(boxelemlist)):
    tmp = []
    for i in boxelemlist[level]:
        for j in boxinfolist[level]:
            if i.GetParameterValueByName("Room Name") == j.name:
                paramDict = j.__dict__
                paramKeys = list(j.__dict__.keys())
                for k in range(len(paramKeys)):
                    if paramKeys[k] == "height" or paramKeys[k] == "length" or paramKeys[k] == "width":
                        pass
                    else:
                        box_value = paramDict[paramKeys[k]]
                        i.SetParameterByName(box_paramlist[k], box_value)
            else:
                pass
        tmp.append(i)
    result.append(tmp)

TransactionManager.Instance.TransactionTaskDone()
    
# Assign your output to the OUT variable.
OUT = result
# ----------------------------------------
