# Dynamo graph 2-3_Room with Param Generating(221202).dyn (Dynamo 2.13.1.3887)

code_block = CodeBlock { {}; }
code_block_2 = CodeBlock { "box obj"; }
categories = Categories("OST_GenericModel")
all_elements_of_category = ElementsOfCategory(Category=categories)
name = Element.Name(element=all_elements_of_category)
code_block_3 = CodeBlock { "Space Planning Box"; }
contains = String.Contains(string=name, searchFor=code_block_3)
filterByBoolMask = List.FilterByBoolMask(list=all_elements_of_category, mask=contains)

# group: box 선별
# set Dictionary
mkNewDicts = Python(IN[0]=code_block, IN[1]=code_block_2, IN[2]=filterByBoolMask.in)  # CPython3
# ---------- mkNewDicts.python (32 lines) ----------
# Load the Python Standard and DesignScript Libraries
import sys
import clr
clr.AddReference('ProtoGeometry')
from Autodesk.DesignScript.Geometry import *

# The inputs to this node will be stored as a list in the IN variables.
dataEnteringNode = IN

preDicts = IN[0]
newKey = IN[1]
newValues = IN[2]

# Place your code below this line

def mkNewDicts(preDicts, newKey, newValues):
    if preDicts == {}:
        preDicts = []
        list(map(lambda x: preDicts.append({}), newValues))
    else:
        pass

    dict_valuePairs = zip(preDicts, newValues)
    
    def mkNewDict(_dict, _key, _value):
        _dict[_key] = _value
        return _dict
    
    result = map(lambda x: mkNewDict(x[0], newKey, x[1]), dict_valuePairs)
    return result
# Assign your output to the OUT variable.
OUT = mkNewDicts(preDicts, newKey, newValues)
# ----------------------------------------

code_block_4 = CodeBlock(d=mkNewDicts) { d; }
code_block_5 = CodeBlock { "box obj"; }
valueAtKey = DesignScript.Builtin.Dictionary.ValueAtKey(dictionary=code_block_4, key=code_block_5)
code_block_6 = CodeBlock { "Level"; }
getParameterValueByName = Element.GetParameterValueByName(element=valueAtKey, parameterName=code_block_6)
string_from_object = FromObject(object=getParameterValueByName)
code_block_7 = CodeBlock()
# ---------- code_block_7.designscript (10 lines) ----------
// 룸세퍼레이션 할 때, 코리더 박스 테두리는 외곽만 반영하도록 처리하고 시작해야 할듯
// (2-1 파일에 반영완료)
// 그래야 한층에 2개 이상의 마감 사양이 다른 코리더 배치 가능해짐

// corridor 들 끼리 매칭

// 층별로 corridor box - corridor room 모아두기
// 박스하나에 룸 하나 - 복도구간이 하나, 당연히 복도 마감사양도 하나
// 박스하나에 룸 둘 - 상호 분리된 복도 2개 이상, 마감 사양은 동일
// 박스 둘에 룸 하나?xx, 박스 둘에 룸 둘 - 상호 분리된 복도 2개 이상, 마감 사양도 2개
# ----------------------------------------
roomParamList = CodeBlock()
# ---------- roomParamList.designscript (7 lines) ----------
[
"Name",
"Department",
"Interior Finish",
"Exterior Finish",
"Limit Offset"
];
# ----------------------------------------
boxParamList = CodeBlock()
# ---------- boxParamList.designscript (7 lines) ----------
[
"Room Name",
"Department",
"Interior Finish",
"Exterior Finish",
"ceiling height"
];
# ----------------------------------------
code_block_8 = CodeBlock { {}; }
code_block_9 = CodeBlock { "room obj"; }
categories_2 = Categories("OST_Rooms")
all_elements_of_category_2 = ElementsOfCategory(Category=categories_2)

# group: room 객체 추출
# set Dictionary
mkNewDicts_2 = Python(IN[0]=code_block_8, IN[1]=code_block_9, IN[2]=all_elements_of_category_2)  # CPython3; same code as mkNewDicts

code_block_10 = CodeBlock(d=mkNewDicts_2) { d; }
code_block_11 = CodeBlock { "room lv"; }
code_block_12 = CodeBlock { "room obj"; }
valueAtKey_2 = DesignScript.Builtin.Dictionary.ValueAtKey(dictionary=code_block_10, key=code_block_12)
code_block_13 = CodeBlock { "Level"; }
getParameterValueByName_2 = Element.GetParameterValueByName(element=valueAtKey_2, parameterName=code_block_13)

# group: room 레벨 추출
# set Dictionary
mkNewDicts_3 = Python(IN[0]=code_block_10, IN[1]=code_block_11, IN[2]=getParameterValueByName_2)  # CPython3; same code as mkNewDicts

code_block_14 = CodeBlock(d=mkNewDicts_3) { d; }
code_block_15 = CodeBlock { "room geo"; }
code_block_16 = CodeBlock { "room obj"; }
valueAtKey_3 = DesignScript.Builtin.Dictionary.ValueAtKey(dictionary=code_block_14, key=code_block_16)
geometry = Element.Geometry(element=valueAtKey_3)
flatten = List.Flatten(list=geometry)

# group: room 형상 추출
# set Dictionary
mkNewDicts_4 = Python(IN[0]=code_block_14, IN[1]=code_block_15, IN[2]=flatten)  # CPython3; same code as mkNewDicts

code_block_17 = CodeBlock(d=mkNewDicts_4) { d; }
code_block_18 = CodeBlock { "room btmSrf"; }
code_block_19 = CodeBlock { "room geo"; }
valueAtKey_4 = DesignScript.Builtin.Dictionary.ValueAtKey(dictionary=code_block_17, key=code_block_19)
explode = Geometry.Explode(geometry=valueAtKey_4)
normalAtParameter = Surface.NormalAtParameter(surface=explode)
code_block_20 = CodeBlock { -1; }
byCoordinates = Vector.ByCoordinates(z=code_block_20)
isAlmostEqualTo = Vector.IsAlmostEqualTo(vector=normalAtParameter, otherVector=byCoordinates)
filterByBoolMask_2 = List.FilterByBoolMask(list=explode, mask=isAlmostEqualTo)
flatten_2 = List.Flatten(list=filterByBoolMask_2.in)

# group: room btmSrf 추출
# set Dictionary
mkNewDicts_5 = Python(IN[0]=code_block_17, IN[1]=code_block_18, IN[2]=flatten_2)  # CPython3; same code as mkNewDicts

code_block_21 = CodeBlock { "room btmCenPoint"; }
code_block_22 = CodeBlock(d=mkNewDicts_5) { d; }
code_block_23 = CodeBlock { "room btmSrf"; }
valueAtKey_5 = DesignScript.Builtin.Dictionary.ValueAtKey(dictionary=code_block_22, key=code_block_23)
code_block_24 = CodeBlock { 0.5; }
pointAtParameter = Surface.PointAtParameter(surface=valueAtKey_5, u=code_block_24, v=code_block_24)

# group: room btmCenPoint
# set Dictionary
mkNewDicts_6 = Python(IN[0]=mkNewDicts_5, IN[1]=code_block_21, IN[2]=pointAtParameter)  # CPython3; same code as mkNewDicts

code_block_25 = CodeBlock { "room offsetBtmSrf"; }
code_block_26 = CodeBlock(d=mkNewDicts_6) { d; }
code_block_27 = CodeBlock { "room btmSrf"; }
valueAtKey_6 = DesignScript.Builtin.Dictionary.ValueAtKey(dictionary=code_block_26, key=code_block_27)
outerPerimeterCurves = AnalyticalAutomation.Geometry.Surface.OuterPerimeterCurves(surface=valueAtKey_6)
flatten_3 = List.Flatten(list=outerPerimeterCurves)
code_block_28 = CodeBlock { -100; }
offset = Curve.Offset(curve=flatten_3, distance=code_block_28)
byPatch = Surface.ByPatch(closedCurve=offset)

# group: room offsetBtmSrf
# set Dictionary
mkNewDicts_7 = Python(IN[0]=mkNewDicts_6, IN[1]=code_block_25, IN[2]=byPatch)  # CPython3; same code as mkNewDicts

code_block_29 = CodeBlock { "room offsetGeo"; }
code_block_30 = CodeBlock { 100; }
boolean = BoolSelector(false)
thicken = Surface.Thicken(surface=byPatch, thickness=code_block_30, both_sides=boolean)

# group: room offsetGeo
# set Dictionary
mkNewDicts_8 = Python(IN[0]=mkNewDicts_7, IN[1]=code_block_29, IN[2]=thicken)  # CPython3; same code as mkNewDicts

room_dict = CodeBlock(d=mkNewDicts_8) { d; }
code_block_31 = CodeBlock { "box_roomName"; }
code_block_32 = CodeBlock { "Room Name"; }
getParameterValueByName_3 = Element.GetParameterValueByName(element=valueAtKey, parameterName=code_block_32)

# group: box별 룸 이름 추출
# set Dictionary
mkNewDicts_9 = Python(IN[0]=code_block_4, IN[1]=code_block_31, IN[2]=getParameterValueByName_3)  # CPython3; same code as mkNewDicts

code_block_33 = CodeBlock { "box lv"; }
name_2 = Level.Name(level=getParameterValueByName)

# group: box 레벨 추출
# set Dictionary
mkNewDicts_10 = Python(IN[0]=mkNewDicts_9, IN[1]=code_block_33, IN[2]=name_2)  # CPython3; same code as mkNewDicts

code_block_34 = CodeBlock(d=mkNewDicts_10) { d; }
code_block_35 = CodeBlock { "box geo"; }
code_block_36 = CodeBlock { "box obj"; }
valueAtKey_7 = DesignScript.Builtin.Dictionary.ValueAtKey(dictionary=code_block_34, key=code_block_36)
geometry_2 = Element.Geometry(element=valueAtKey_7)
flatten_4 = List.Flatten(list=geometry_2)

# group: box 형상 추출
# set Dictionary
mkNewDicts_11 = Python(IN[0]=code_block_34, IN[1]=code_block_35, IN[2]=flatten_4)  # CPython3; same code as mkNewDicts

code_block_37 = CodeBlock { "box btmSrf"; }
code_block_38 = CodeBlock(d=mkNewDicts_11) { d; }
findBoxesBtmSrfCenter = Python(IN[0]=code_block_38)  # CPython3
# ---------- findBoxesBtmSrfCenter.python (25 lines) ----------
# Load the Python Standard and DesignScript Libraries
import sys
import clr
clr.AddReference('ProtoGeometry')
from Autodesk.DesignScript.Geometry import *

# The inputs to this node will be stored as a list in the IN variables.
dataEnteringNode = IN
boxDicts = IN[0]

# Place your code below this line

def findBoxesBtmSrfCenter(boxDicts):
    btmSrfs = map(findBoxBtmSrf, boxDicts)
    res = map(lambda x: x.PointAtParameter(0.5,0.5), btmSrfs)
    return res

def findBoxBtmSrf(boxDict):
    reverseZvec = Vector.ByCoordinates(0,0,-1)
    srfs = Geometry.Explode(boxDict["box geo"])
    btmSrf = filter(lambda x: x.NormalAtParameter(0.5,0.5).IsAlmostEqualTo(reverseZvec), srfs)
    return list(btmSrf)[0]

# Assign your output to the OUT variable.
OUT = (map(findBoxBtmSrf, boxDicts), findBoxesBtmSrfCenter(boxDicts))
# ----------------------------------------
code_block_39 = CodeBlock(i=findBoxesBtmSrfCenter)
# ---------- code_block_39.designscript (4 lines) ----------
i[0];
 //btm srfs;
i[1];
 //btm cenPoint;
# ----------------------------------------

# group: box 하부면 추출
# set Dictionary
mkNewDicts_12 = Python(IN[0]=mkNewDicts_11, IN[1]=code_block_37, IN[2]=code_block_39.out0)  # CPython3; same code as mkNewDicts

code_block_40 = CodeBlock { "box btmCenPoint"; }

# group: box 하부 중심점 추출
# set Dictionary
mkNewDicts_13 = Python(IN[0]=mkNewDicts_12, IN[1]=code_block_40, IN[2]=code_block_39.out1)  # CPython3; same code as mkNewDicts

box_dict = CodeBlock(d=mkNewDicts_13) { d; }
separate_room_corridor_others = Python(IN[0]=room_dict, IN[1]=box_dict)  # CPython3
# ---------- separate_room_corridor_others.python (71 lines) ----------
# Load the Python Standard and DesignScript Libraries
import sys
import clr
clr.AddReference('ProtoGeometry')
from Autodesk.DesignScript.Geometry import *
#from itertools import groupby
#import operator

# The inputs to this node will be stored as a list in the IN variables.
dataEnteringNode = IN
roomDicts = IN[0]
boxDicts = IN[1]

# Place your code below this line

def groupBy(keys, values):
    res = {}
    pair = list(zip(keys, values))
    uniqueKeys = set(keys)
    for uniKey in uniqueKeys:
        tmp = []
        for k,v in pair:
            if k in uniKey:
                tmp.append(v)    
        res[uniKey] = tmp
    return res



def countIntsctTimesEach(boxDicts, roomDict):
    roomGeo = roomDict["room offsetGeo"]
    boxDictsSameFloor = filter(lambda x: x["box lv"] == roomDict["room lv"], boxDicts)
    boxGeos = map(lambda x: x["box geo"], boxDictsSameFloor)
    chkResult = filter(lambda x: roomGeo.DoesIntersect(x), boxGeos)
    
    return len(list(chkResult))



def findNoCorridorLv(boxDicts):
    res = []
    keys = list(map(lambda x: x["box lv"], boxDicts))
    boxesByFloor = groupBy(keys, boxDicts)
    for k,v in boxesByFloor.items():
        tmp = []
        for j in v:
            if j["box_roomName"] == "Corridor":
                tmp.append(False)
            else: tmp.append(True)
        if all(tmp):
            res.append(k)
            
    return res
    
def separateCorridor(boxDicts, roomDicts):
    (corridors, noCorridors) = [], []
    noCorridorLv = findNoCorridorLv(boxDicts)
    for i in roomDicts:
        if i["room lv"] in noCorridorLv:
            noCorridors.append(i)
        else:
            if countIntsctTimesEach(boxDicts, i) == 1:
                corridors.append(i)
            else: noCorridors.append(i)
    return {"corridorRoom": corridors, "noCorridorRoom": noCorridors}

#res = filter(lambda x: countIntsctTimesEach(boxDicts, x) == 1, roomDicts)


# Assign your output to the OUT variable.
OUT = separateCorridor(boxDicts, roomDicts)
# ----------------------------------------
code_block_41 = CodeBlock(i=separate_room_corridor_others) { i["corridorRoom"]; }
seperate_box_corridor_others = Python(IN[0]=box_dict)  # CPython3
# ---------- seperate_box_corridor_others.python (21 lines) ----------
# Load the Python Standard and DesignScript Libraries
import sys
import clr
clr.AddReference('ProtoGeometry')
from Autodesk.DesignScript.Geometry import *

# The inputs to this node will be stored as a list in the IN variables.
dataEnteringNode = IN
boxDicts = IN[0]

# Place your code below this line

def separateCorridorBox(boxDicts):
    a = filter(lambda x: x["box_roomName"] == "Corridor", boxDicts)
    b = filter(lambda x: x["box_roomName"] != "Corridor", boxDicts)
    
    return {"corridorBox": a, "noCorridorBox": b}


# Assign your output to the OUT variable.
OUT = separateCorridorBox(boxDicts)
# ----------------------------------------
code_block_42 = CodeBlock(i=seperate_box_corridor_others) { i["corridorBox"]; }
match_roomAndbox_corridor = Python(IN[0]=code_block_41, IN[1]=code_block_42)  # CPython3
# ---------- match_roomAndbox_corridor.python (32 lines) ----------
# Load the Python Standard and DesignScript Libraries
import sys
import clr
clr.AddReference('ProtoGeometry')
from Autodesk.DesignScript.Geometry import *

# The inputs to this node will be stored as a list in the IN variables.
dataEnteringNode = IN
roomDicts = IN[0]
boxDicts = IN[1]

# Place your code below this line
def isInclude(roomDict, boxDict):
    roomOffsetBtmSrf = roomDict["room offsetBtmSrf"]
    boxBtmSrf = boxDict["box btmSrf"]
    try:
        diff = roomOffsetBtmSrf.Difference([boxBtmSrf])
    except:
        return True
    else:
        return False


def match_roomAndbox_corridor(roomDict, boxDicts):
    res = list(filter(lambda x: isInclude(roomDict, x), boxDicts))
    roomDict["matchedBox"] = res[0]
    return roomDict

            

# Assign your output to the OUT variable.
OUT = map(lambda x: match_roomAndbox_corridor(x, boxDicts), roomDicts)
# ----------------------------------------
code_block_43 = CodeBlock(i=separate_room_corridor_others) { i["noCorridorRoom"]; }
code_block_44 = CodeBlock(i=seperate_box_corridor_others) { i["noCorridorBox"]; }
match_roomAndbox = Python(IN[0]=code_block_43, IN[1]=code_block_44)  # CPython3
# ---------- match_roomAndbox.python (58 lines) ----------
# Load the Python Standard and DesignScript Libraries
import sys
import clr
clr.AddReference('ProtoGeometry')
from Autodesk.DesignScript.Geometry import *

# The inputs to this node will be stored as a list in the IN variables.
dataEnteringNode = IN
roomDicts = IN[0]
boxDicts = IN[1]

# Place your code below this line
#def isCenPointEqual(roomDict, boxDict):
#    roomCenPt = roomDict["room btmCenPoint"]
#    boxCenPt = boxDict["box btmCenPoint"]
#    return roomCenPt.IsAlmostEqualTo(boxCenPt)
#
#
#def match_roomAndbox(roomDict, boxDicts):
#    res = filter(lambda x: isCenPointEqual(roomDict, x), boxDicts)
#    roomDict["matchedBox"] = res
#    return roomDict
            

def isInclude(roomDict, boxDict):
    roomBtmSrf = roomDict["room btmSrf"]
    boxBtmSrf = boxDict["box btmSrf"]
    try:
        diff = roomBtmSrf.Difference([boxBtmSrf])
#        diff = roomOffsetBtmSrf.Difference([boxBtmSrf])
    except:
        return True
    else:
        return False


def match_roomAndbox(roomDict, boxDicts):
    res = list(filter(lambda x: isInclude(roomDict, x), boxDicts))
    if len(res) > 1:
        roomBtmSrf = roomDict["room btmSrf"]
        boxBtmSrfs = map(lambda x: x["box btmSrf"], res)
        def findRatio(roomBtmSrf, boxBtmSrf):
            roomArea = roomBtmSrf.Area
            boxArea = boxBtmSrf.Area
            return roomArea/boxArea
        ratios = list(map(lambda x: findRatio(roomBtmSrf, x), boxBtmSrfs))
        maxRatioIdx = ratios.index(max(ratios))
        
        resNew =  res[maxRatioIdx]
        roomDict["matchedBox"] = resNew
    else:
        roomDict["matchedBox"] = res[0]
    return roomDict


# Assign your output to the OUT variable.
#OUT = map(lambda x: match_roomAndbox(x, boxDicts), roomDicts)
OUT = map(lambda x: match_roomAndbox(x, boxDicts), roomDicts)
# ----------------------------------------
join = List.Join(list0=match_roomAndbox_corridor, list1=match_roomAndbox)
setRoomParameterValues = Python(IN[0]=roomParamList, IN[1]=boxParamList, IN[2]=join)  # CPython3
# ---------- setRoomParameterValues.python (62 lines) ----------
# Load the Python Standard and DesignScript Libraries
import sys
import clr
clr.AddReference('ProtoGeometry')
from Autodesk.DesignScript.Geometry import *

# The inputs to this node will be stored as a list in the IN variables.
dataEnteringNode = IN
roomParamList = IN[0]
boxParamList = IN[1]
roomDicts = IN[2]

# Place your code below this line
def setRoomParameterValues(roomParamList, boxParamList, roomDict):
    roomObj = roomDict["room obj"]
    boxDict = roomDict["matchedBox"]
    boxObj = boxDict["box obj"]
    paramPair = zip(roomParamList, boxParamList)
    

    for rP,bP in paramPair:
        paramValue = boxObj.GetParameterValueByName(bP)
        
        if bP == "ceiling height" and paramValue != 0:
            roomObj.SetParameterByName(rP, paramValue)
            
        elif bP == "ceiling height" and paramValue == 0:
            height = boxObj.GetParameterValueByName("Height")
            roomObj.SetParameterByName(rP, height)
            
        elif bP == "Interior Finish":
            paramValue = boxObj.GetParameterValueByName(bP)
            paramValueSplitList = paramValue.split(",,")
            wallType = ','.join(
                list(filter(lambda x: x != "N/A",
                    paramValueSplitList[0].split(".."))))
            baseType = ','.join(
                list(filter(lambda x: x != "N/A",
                    paramValueSplitList[1].split(".."))))
            floorType = ','.join(
                list(filter(lambda x: x != "N/A",
                    paramValueSplitList[2].split(".."))))
            ceilType = ','.join(
                list(filter(lambda x: x != "N/A",
                    paramValueSplitList[3].split(".."))))
            
            roomObj.SetParameterByName("Wall Finish", wallType)
            roomObj.SetParameterByName("Base Finish", baseType)
            roomObj.SetParameterByName("Floor Finish", floorType)
            roomObj.SetParameterByName("Ceiling Finish", ceilType)
            roomObj.SetParameterByName(rP, paramValue)
        
        else:
            paramValue = boxObj.GetParameterValueByName(bP)
            roomObj.SetParameterByName(rP, paramValue)
    
    return roomDict
    


# Assign your output to the OUT variable.
OUT = map(lambda x: setRoomParameterValues(roomParamList, boxParamList, x), roomDicts)
# ----------------------------------------
setparameter_result = Watch(setRoomParameterValues)  # graph output
대상_객체_필터링 = Watch(filterByBoolMask.in)
