# Dynamo graph 4_Bidding Quantity Calculation(220623).dyn (Dynamo 2.12.0.5650)

# group: Input_Excel related
n1_file_path = Filename(".\01_Building List_Pilot Project_2022_0218.xlsx")  # "1. File Path"; graph input
n2_sheet_name = StringInput("Finish Code")  # "2. Sheet Name"; graph input

# group: Github_Python@Import Excel(By OpenpyXl)
string_from_web = Python()  # CPython3; frozen; unwired: IN[0]
# ---------- string_from_web.python (19 lines) ----------
# Load the Python Standard and DesignScript Libraries
import sys
import clr
clr.AddReference('ProtoGeometry')
from Autodesk.DesignScript.Geometry import *
import urllib.request

# The inputs to this node will be stored as a list in the IN variables.
dataEnteringNode = IN
inputURL = "https://raw.githubusercontent.com/hnanmal/mQ/master/Laboratory/20211123_%EC%9E%85%EC%B0%B0%EC%9E%90%EB%8F%99%ED%99%94%ED%88%B4Test%20Sample/test.py"

# Place your code below this line
req = urllib.request
data = req.urlopen(inputURL)

result = data.read().decode("utf-8")

# Assign your output to the OUT variable.
OUT = result
# ----------------------------------------
python_script_from_string = PythonStringNode(script=string_from_web, IN[0]=n1_file_path, IN[1]=n2_sheet_name)  # CPython3

# group: Input_Excel related
n1_file_path_2 = Filename(".\01_Building List_Pilot Project_2021_1211_mk.xlsx")  # "1. File Path"; graph input
n2_sheet_name_2 = StringInput("Finish Code")  # "2. Sheet Name"; graph input

python_script = Python(IN[0]=n1_file_path_2, IN[1]=n2_sheet_name)  # CPython3
# ---------- python_script.python (90 lines) ----------
# Load the Python Standard and DesignScript Libraries
import os
python_rootpath = os.getenv('LOCALAPPDATA')+'\Programs\Python'
file_list = os.listdir(python_rootpath)
python_version = file_list[-1]
import sys
sys.path.append(os.getenv('LOCALAPPDATA').replace('\\','\\\\') + f'\Programs\Python\{python_version}\Lib\site-packages')
import clr
clr.AddReference('RevitAPI')
import Autodesk

clr.AddReference('ProtoGeometry')
from Autodesk.DesignScript.Geometry import *

clr.AddReference('RevitNodes')
import Revit
clr.ImportExtensions(Revit.Elements)

clr.ImportExtensions(Revit.GeometryConversion)
clr.ImportExtensions(Revit.GeometryReferences)

clr.AddReference('RevitServices')
import RevitServices
from RevitServices.Persistence import DocumentManager
from RevitServices.Transactions import TransactionManager

doc = DocumentManager.Instance.CurrentDBDocument

import random
import itertools
from functools import reduce
from collections import Iterable
import datetime
import openpyxl

# The inputs to this node will be stored as a list in the IN variables.
dataEnteringNode = IN
inputFilePath = IN[0]
inputSheetName = IN[1]

def importExcel(path, SheetNameIn):
    wb_obj = openpyxl.load_workbook(str(path), data_only=True)
    sheet_obj = wb_obj.get_sheet_by_name(str(SheetNameIn))

    m_row = sheet_obj.max_row
    m_col = sheet_obj.max_column

    listOut = []

    for i in range(1, m_row +1):
        listTemp = []
        for j in range(1, m_col + 1):
            cell_obj = sheet_obj.cell(row=i, column=j)
            listTemp.append(cell_obj.value)
            if len(listTemp) == m_col:
                listOut.append(listTemp)
    return listOut

def checkAllElement(list, target):
    tmp=[]
    for i in list:
        if i == target:
            tmp.append(True)
        else:
            tmp.append(False)
    return all(tmp)


# Place your code below this line

result = importExcel(inputFilePath, inputSheetName)

for i in result:## null만 있는 Excel Row 제거
    if checkAllElement(i, None):
        result.remove(i)
    else:
        pass
        
result_tr = list(zip(*result))

for i in result_tr:## null만 있는 Excel Column 제거
    if checkAllElement(i, None):
        result_tr.remove(i)
    else:
        pass

result = list(zip(*result_tr))

# Assign your output to the OUT variable.
OUT = result
# ----------------------------------------

# group: Data bunch 분할_Row기반
code_block = CodeBlock { 2; }
dropItems = List.DropItems(list=python_script, amount=code_block)
string_from_object = FromObject(object=dropItems)
firstItem = List.FirstItem(list=string_from_object@L2)
code_block_2 = CodeBlock { "Base Material"; }
contains = String.Contains(string=firstItem, searchFor=code_block_2)
code_block_3 = CodeBlock { true; }
allIndicesOf = List.AllIndicesOf(list=contains, item=code_block_3)
python_script_data_bunch_분할_행기반 = Python(IN[0]=allIndicesOf)  # CPython3
# ---------- python_script_data_bunch_분할_행기반.python (22 lines) ----------
# Load the Python Standard and DesignScript Libraries
import sys
import clr
clr.AddReference('ProtoGeometry')
from Autodesk.DesignScript.Geometry import *

# The inputs to this node will be stored as a list in the IN variables.
dataEnteringNode = IN
inlist = IN[0]

# Place your code below this line
result = []
for i in range(len(inlist)):
    if i < len(inlist)-1:
        sub = inlist[i+1] - inlist[i]
        result.append(sub)
    else:
        pass


# Assign your output to the OUT variable.
OUT = result
# ----------------------------------------
chop = List.Chop(list=dropItems, lengths=python_script_data_bunch_분할_행기반)

# group: 마감 종류별 Dictionary 정리- Roof, Wall, Base, Floor, Ceiling
code_block_4 = CodeBlock { 1; }
getItemAtIndex = List.GetItemAtIndex(list=chop@L3, index=code_block_4)
firstItem_2 = List.FirstItem(list=getItemAtIndex@L2)
byKeysValues = DesignScript.Builtin.Dictionary.ByKeysValues(keys=firstItem_2, values=chop)

# group: Finish Type 코드가 있는 Column 인덱스 추출
firstItem_3 = List.FirstItem(list=chop@L3)
code_block_5 = CodeBlock { "Finish"; }
eq = firstItem_3 == code_block_5
code_block_6 = CodeBlock { true; }
allIndicesOf_2 = List.AllIndicesOf(list=eq@L2, item=code_block_6)
flatten = List.Flatten(list=allIndicesOf_2)
uniqueItems = List.UniqueItems(list=flatten)
code_block_7 = CodeBlock(i=uniqueItems) { i[0]; }

code_block_8 = CodeBlock { "Roof"; "RF"; }

# group: Type 별 WM 추출 - Roof
code_block_9 = CodeBlock(TypeDictionary=byKeysValues, FinishCodeIndex=code_block_7, FinishType=code_block_8.out0, FinishTypeMark=code_block_8.out1)
# ---------- code_block_9.designscript (10 lines) ----------
i={
"TypeDictionary": TypeDictionary,
"FinishCodeIndex": FinishCodeIndex,
"FinishType": FinishType,
"FinishTypeMark": FinishTypeMark
};
i["TypeDictionary"];
i["FinishCodeIndex"];
i["FinishType"];
i["FinishTypeMark"];
# ----------------------------------------
valueAtKey = DesignScript.Builtin.Dictionary.ValueAtKey(dictionary=code_block_9.out1, key=code_block_9.out3)
getItemAtIndex_2 = List.GetItemAtIndex(list=valueAtKey@L2, index=code_block_9.out2)
contains_2 = String.Contains(string=getItemAtIndex_2, searchFor=code_block_9.out4)
code_block_10 = CodeBlock { true; }
allIndicesOf_3 = List.AllIndicesOf(list=contains_2, item=code_block_10)
getItemAtIndex_3 = List.GetItemAtIndex(list=valueAtKey@L3, index=allIndicesOf_3)
code_block_11 = CodeBlock(i=code_block_9.out2) { i; }
dropItems_2 = List.DropItems(list=getItemAtIndex_3@L2, amount=code_block_11)
firstItem_4 = List.FirstItem(list=dropItems_2@L2)
string_from_object_2 = FromObject(object=dropItems_2)
code_block_12 = CodeBlock { "O"; }
allIndicesOf_4 = List.AllIndicesOf(list=string_from_object_2@L2, item=code_block_12)
python_script_empty_list_indices = Python(IN[0]=allIndicesOf_4)  # CPython3
# ---------- python_script_empty_list_indices.python (19 lines) ----------
# Load the Python Standard and DesignScript Libraries
import sys
import clr
clr.AddReference('ProtoGeometry')
from Autodesk.DesignScript.Geometry import *

# The inputs to this node will be stored as a list in the IN variables.
dataEnteringNode = IN

inlist = IN[0]
# Place your code below this line
result = []
for i in range(len(inlist)):
    if inlist[i]:
        pass
    else:
        result.append(i)
# Assign your output to the OUT variable.
OUT = result
# ----------------------------------------
removeItemAtIndex = List.RemoveItemAtIndex(list=firstItem_4, indices=python_script_empty_list_indices)
code_block_13 = CodeBlock { 2; }
getItemAtIndex_4 = List.GetItemAtIndex(list=valueAtKey@L3, index=code_block_13)
dropItems_3 = List.DropItems(list=getItemAtIndex_4@L2, amount=code_block_11)
flatten_2 = List.Flatten(list=dropItems_3)
python_script_empty_list_제거 = Python(IN[0]=allIndicesOf_4)  # CPython3
# ---------- python_script_empty_list_제거.python (19 lines) ----------
# Load the Python Standard and DesignScript Libraries
import sys
import clr
clr.AddReference('ProtoGeometry')
from Autodesk.DesignScript.Geometry import *

# The inputs to this node will be stored as a list in the IN variables.
dataEnteringNode = IN

inlist = IN[0]
# Place your code below this line
result = []
for i in inlist:
    if i:
        result.append(i)
    else:
        pass
# Assign your output to the OUT variable.
OUT = result
# ----------------------------------------
getItemAtIndex_5 = List.GetItemAtIndex(list=flatten_2, index=python_script_empty_list_제거@L2)
code_block_14 = CodeBlock { 1; }
getItemAtIndex_6 = List.GetItemAtIndex(list=valueAtKey@L3, index=code_block_14)
dropItems_4 = List.DropItems(list=getItemAtIndex_6@L2, amount=code_block_11)
flatten_3 = List.Flatten(list=dropItems_4)
getItemAtIndex_7 = List.GetItemAtIndex(list=flatten_3, index=python_script_empty_list_제거@L2)
code_block_15 = CodeBlock(a=getItemAtIndex_5, b=getItemAtIndex_7) { a+": "+b; }
byKeysValues_2 = DesignScript.Builtin.Dictionary.ByKeysValues(keys=removeItemAtIndex, values=code_block_15)

code_block_16 = CodeBlock { "Exterior Wall"; "EW"; }

# group: Type 별 WM 추출 - Exterior Wall
code_block_17 = CodeBlock(TypeDictionary=byKeysValues, FinishCodeIndex=code_block_7, FinishType=code_block_16.out0, FinishTypeMark=code_block_16.out1)  # same code as code_block_9
valueAtKey_2 = DesignScript.Builtin.Dictionary.ValueAtKey(dictionary=code_block_17.out1, key=code_block_17.out3)
getItemAtIndex_8 = List.GetItemAtIndex(list=valueAtKey_2@L2, index=code_block_17.out2)
contains_3 = String.Contains(string=getItemAtIndex_8, searchFor=code_block_17.out4)
code_block_18 = CodeBlock { true; }
allIndicesOf_5 = List.AllIndicesOf(list=contains_3, item=code_block_18)
getItemAtIndex_9 = List.GetItemAtIndex(list=valueAtKey_2@L3, index=allIndicesOf_5)
code_block_19 = CodeBlock(i=code_block_17.out2) { i; }
dropItems_5 = List.DropItems(list=getItemAtIndex_9@L2, amount=code_block_19)
firstItem_5 = List.FirstItem(list=dropItems_5@L2)
string_from_object_3 = FromObject(object=dropItems_5)
code_block_20 = CodeBlock { "O"; }
allIndicesOf_6 = List.AllIndicesOf(list=string_from_object_3@L2, item=code_block_20)
python_script_empty_list_indices_2 = Python(IN[0]=allIndicesOf_6)  # CPython3; same code as python_script_empty_list_indices
removeItemAtIndex_2 = List.RemoveItemAtIndex(list=firstItem_5, indices=python_script_empty_list_indices_2)
code_block_21 = CodeBlock { 2; }
getItemAtIndex_10 = List.GetItemAtIndex(list=valueAtKey_2@L3, index=code_block_21)
dropItems_6 = List.DropItems(list=getItemAtIndex_10@L2, amount=code_block_19)
flatten_4 = List.Flatten(list=dropItems_6)
python_script_empty_list_제거_2 = Python(IN[0]=allIndicesOf_6)  # CPython3; same code as python_script_empty_list_제거
getItemAtIndex_11 = List.GetItemAtIndex(list=flatten_4, index=python_script_empty_list_제거_2@L2)
code_block_22 = CodeBlock { 1; }
getItemAtIndex_12 = List.GetItemAtIndex(list=valueAtKey_2@L3, index=code_block_22)
dropItems_7 = List.DropItems(list=getItemAtIndex_12@L2, amount=code_block_19)
flatten_5 = List.Flatten(list=dropItems_7)
getItemAtIndex_13 = List.GetItemAtIndex(list=flatten_5, index=python_script_empty_list_제거_2@L2)
code_block_23 = CodeBlock(a=getItemAtIndex_11, b=getItemAtIndex_13) { a+": "+b; }
byKeysValues_3 = DesignScript.Builtin.Dictionary.ByKeysValues(keys=removeItemAtIndex_2, values=code_block_23)

code_block_24 = CodeBlock { "Interior Wall"; "IW"; }

# group: Type 별 WM 추출 - Interior Wall
code_block_25 = CodeBlock(TypeDictionary=byKeysValues, FinishCodeIndex=code_block_7, FinishType=code_block_24.out0, FinishTypeMark=code_block_24.out1)  # same code as code_block_9
valueAtKey_3 = DesignScript.Builtin.Dictionary.ValueAtKey(dictionary=code_block_25.out1, key=code_block_25.out3)
getItemAtIndex_14 = List.GetItemAtIndex(list=valueAtKey_3@L2, index=code_block_25.out2)
contains_4 = String.Contains(string=getItemAtIndex_14, searchFor=code_block_25.out4)
code_block_26 = CodeBlock { true; }
allIndicesOf_7 = List.AllIndicesOf(list=contains_4, item=code_block_26)
getItemAtIndex_15 = List.GetItemAtIndex(list=valueAtKey_3@L3, index=allIndicesOf_7)
code_block_27 = CodeBlock(i=code_block_25.out2) { i; }
dropItems_8 = List.DropItems(list=getItemAtIndex_15@L2, amount=code_block_27)
firstItem_6 = List.FirstItem(list=dropItems_8@L2)
string_from_object_4 = FromObject(object=dropItems_8)
code_block_28 = CodeBlock { "O"; }
allIndicesOf_8 = List.AllIndicesOf(list=string_from_object_4@L2, item=code_block_28)
python_script_empty_list_indices_3 = Python(IN[0]=allIndicesOf_8)  # CPython3; same code as python_script_empty_list_indices
removeItemAtIndex_3 = List.RemoveItemAtIndex(list=firstItem_6, indices=python_script_empty_list_indices_3)
code_block_29 = CodeBlock { 2; }
getItemAtIndex_16 = List.GetItemAtIndex(list=valueAtKey_3@L3, index=code_block_29)
dropItems_9 = List.DropItems(list=getItemAtIndex_16@L2, amount=code_block_27)
flatten_6 = List.Flatten(list=dropItems_9)
python_script_empty_list_제거_3 = Python(IN[0]=allIndicesOf_8)  # CPython3; same code as python_script_empty_list_제거
getItemAtIndex_17 = List.GetItemAtIndex(list=flatten_6, index=python_script_empty_list_제거_3@L2)
code_block_30 = CodeBlock { 1; }
getItemAtIndex_18 = List.GetItemAtIndex(list=valueAtKey_3@L3, index=code_block_30)
dropItems_10 = List.DropItems(list=getItemAtIndex_18@L2, amount=code_block_27)
flatten_7 = List.Flatten(list=dropItems_10)
getItemAtIndex_19 = List.GetItemAtIndex(list=flatten_7, index=python_script_empty_list_제거_3@L2)
code_block_31 = CodeBlock(a=getItemAtIndex_17, b=getItemAtIndex_19) { a+": "+b; }
byKeysValues_4 = DesignScript.Builtin.Dictionary.ByKeysValues(keys=removeItemAtIndex_3, values=code_block_31)

code_block_32 = CodeBlock { "Interior Base"; "WK"; }

# group: Type 별 WM 추출 - Interior Base
code_block_33 = CodeBlock(TypeDictionary=byKeysValues, FinishCodeIndex=code_block_7, FinishType=code_block_32.out0, FinishTypeMark=code_block_32.out1)  # same code as code_block_9
valueAtKey_4 = DesignScript.Builtin.Dictionary.ValueAtKey(dictionary=code_block_33.out1, key=code_block_33.out3)
getItemAtIndex_20 = List.GetItemAtIndex(list=valueAtKey_4@L2, index=code_block_33.out2)
contains_5 = String.Contains(string=getItemAtIndex_20, searchFor=code_block_33.out4)
code_block_34 = CodeBlock { true; }
allIndicesOf_9 = List.AllIndicesOf(list=contains_5, item=code_block_34)
getItemAtIndex_21 = List.GetItemAtIndex(list=valueAtKey_4@L3, index=allIndicesOf_9)
code_block_35 = CodeBlock(i=code_block_33.out2) { i; }
dropItems_11 = List.DropItems(list=getItemAtIndex_21@L2, amount=code_block_35)
firstItem_7 = List.FirstItem(list=dropItems_11@L2)
string_from_object_5 = FromObject(object=dropItems_11)
code_block_36 = CodeBlock { "O"; }
allIndicesOf_10 = List.AllIndicesOf(list=string_from_object_5@L2, item=code_block_36)
python_script_empty_list_indices_4 = Python(IN[0]=allIndicesOf_10)  # CPython3; same code as python_script_empty_list_indices
removeItemAtIndex_4 = List.RemoveItemAtIndex(list=firstItem_7, indices=python_script_empty_list_indices_4)
code_block_37 = CodeBlock { 2; }
getItemAtIndex_22 = List.GetItemAtIndex(list=valueAtKey_4@L3, index=code_block_37)
dropItems_12 = List.DropItems(list=getItemAtIndex_22@L2, amount=code_block_35)
flatten_8 = List.Flatten(list=dropItems_12)
python_script_empty_list_제거_4 = Python(IN[0]=allIndicesOf_10)  # CPython3; same code as python_script_empty_list_제거
getItemAtIndex_23 = List.GetItemAtIndex(list=flatten_8, index=python_script_empty_list_제거_4@L2)
code_block_38 = CodeBlock { 1; }
getItemAtIndex_24 = List.GetItemAtIndex(list=valueAtKey_4@L3, index=code_block_38)
dropItems_13 = List.DropItems(list=getItemAtIndex_24@L2, amount=code_block_35)
flatten_9 = List.Flatten(list=dropItems_13)
getItemAtIndex_25 = List.GetItemAtIndex(list=flatten_9, index=python_script_empty_list_제거_4@L2)
code_block_39 = CodeBlock(a=getItemAtIndex_23, b=getItemAtIndex_25) { a+": "+b; }
byKeysValues_5 = DesignScript.Builtin.Dictionary.ByKeysValues(keys=removeItemAtIndex_4, values=code_block_39)

code_block_40 = CodeBlock { "Interior Floor"; "FL"; }

# group: Type 별 WM 추출 - Interior Floor
code_block_41 = CodeBlock(TypeDictionary=byKeysValues, FinishCodeIndex=code_block_7, FinishType=code_block_40.out0, FinishTypeMark=code_block_40.out1)  # same code as code_block_9
valueAtKey_5 = DesignScript.Builtin.Dictionary.ValueAtKey(dictionary=code_block_41.out1, key=code_block_41.out3)
getItemAtIndex_26 = List.GetItemAtIndex(list=valueAtKey_5@L2, index=code_block_41.out2)
contains_6 = String.Contains(string=getItemAtIndex_26, searchFor=code_block_41.out4)
code_block_42 = CodeBlock { true; }
allIndicesOf_11 = List.AllIndicesOf(list=contains_6, item=code_block_42)
getItemAtIndex_27 = List.GetItemAtIndex(list=valueAtKey_5@L3, index=allIndicesOf_11)
code_block_43 = CodeBlock(i=code_block_41.out2) { i; }
dropItems_14 = List.DropItems(list=getItemAtIndex_27@L2, amount=code_block_43)
firstItem_8 = List.FirstItem(list=dropItems_14@L2)
string_from_object_6 = FromObject(object=dropItems_14)
code_block_44 = CodeBlock { "O"; }
allIndicesOf_12 = List.AllIndicesOf(list=string_from_object_6@L2, item=code_block_44)
python_script_empty_list_indices_5 = Python(IN[0]=allIndicesOf_12)  # CPython3; same code as python_script_empty_list_indices
removeItemAtIndex_5 = List.RemoveItemAtIndex(list=firstItem_8, indices=python_script_empty_list_indices_5)
code_block_45 = CodeBlock { 2; }
getItemAtIndex_28 = List.GetItemAtIndex(list=valueAtKey_5@L3, index=code_block_45)
dropItems_15 = List.DropItems(list=getItemAtIndex_28@L2, amount=code_block_43)
flatten_10 = List.Flatten(list=dropItems_15)
python_script_empty_list_제거_5 = Python(IN[0]=allIndicesOf_12)  # CPython3; same code as python_script_empty_list_제거
getItemAtIndex_29 = List.GetItemAtIndex(list=flatten_10, index=python_script_empty_list_제거_5@L2)
code_block_46 = CodeBlock { 1; }
getItemAtIndex_30 = List.GetItemAtIndex(list=valueAtKey_5@L3, index=code_block_46)
dropItems_16 = List.DropItems(list=getItemAtIndex_30@L2, amount=code_block_43)
flatten_11 = List.Flatten(list=dropItems_16)
getItemAtIndex_31 = List.GetItemAtIndex(list=flatten_11, index=python_script_empty_list_제거_5@L2)
code_block_47 = CodeBlock(a=getItemAtIndex_29, b=getItemAtIndex_31) { a+": "+b; }
byKeysValues_6 = DesignScript.Builtin.Dictionary.ByKeysValues(keys=removeItemAtIndex_5, values=code_block_47)

code_block_48 = CodeBlock { "Interior Ceiling"; "CL"; }

# group: Type 별 WM 추출 - Interior Ceiling
code_block_49 = CodeBlock(TypeDictionary=byKeysValues, FinishCodeIndex=code_block_7, FinishType=code_block_48.out0, FinishTypeMark=code_block_48.out1)  # same code as code_block_9
valueAtKey_6 = DesignScript.Builtin.Dictionary.ValueAtKey(dictionary=code_block_49.out1, key=code_block_49.out3)
getItemAtIndex_32 = List.GetItemAtIndex(list=valueAtKey_6@L2, index=code_block_49.out2)
contains_7 = String.Contains(string=getItemAtIndex_32, searchFor=code_block_49.out4)
code_block_50 = CodeBlock { true; }
allIndicesOf_13 = List.AllIndicesOf(list=contains_7, item=code_block_50)
getItemAtIndex_33 = List.GetItemAtIndex(list=valueAtKey_6@L3, index=allIndicesOf_13)
code_block_51 = CodeBlock(i=code_block_49.out2) { i; }
dropItems_17 = List.DropItems(list=getItemAtIndex_33@L2, amount=code_block_51)
firstItem_9 = List.FirstItem(list=dropItems_17@L2)
string_from_object_7 = FromObject(object=dropItems_17)
code_block_52 = CodeBlock { "O"; }
allIndicesOf_14 = List.AllIndicesOf(list=string_from_object_7@L2, item=code_block_52)
python_script_empty_list_indices_6 = Python(IN[0]=allIndicesOf_14)  # CPython3; same code as python_script_empty_list_indices
removeItemAtIndex_6 = List.RemoveItemAtIndex(list=firstItem_9, indices=python_script_empty_list_indices_6)
code_block_53 = CodeBlock { 2; }
getItemAtIndex_34 = List.GetItemAtIndex(list=valueAtKey_6@L3, index=code_block_53)
dropItems_18 = List.DropItems(list=getItemAtIndex_34@L2, amount=code_block_51)
flatten_12 = List.Flatten(list=dropItems_18)
python_script_empty_list_제거_6 = Python(IN[0]=allIndicesOf_14)  # CPython3; same code as python_script_empty_list_제거
getItemAtIndex_35 = List.GetItemAtIndex(list=flatten_12, index=python_script_empty_list_제거_6@L2)
code_block_54 = CodeBlock { 1; }
getItemAtIndex_36 = List.GetItemAtIndex(list=valueAtKey_6@L3, index=code_block_54)
dropItems_19 = List.DropItems(list=getItemAtIndex_36@L2, amount=code_block_51)
flatten_13 = List.Flatten(list=dropItems_19)
getItemAtIndex_37 = List.GetItemAtIndex(list=flatten_13, index=python_script_empty_list_제거_6@L2)
code_block_55 = CodeBlock(a=getItemAtIndex_35, b=getItemAtIndex_37) { a+": "+b; }
byKeysValues_7 = DesignScript.Builtin.Dictionary.ByKeysValues(keys=removeItemAtIndex_6, values=code_block_55)

# group: Merge FinishType Dicts
string_from_web_2 = Python()  # CPython3; frozen; unwired: IN[0]
# ---------- string_from_web_2.python (19 lines) ----------
# Load the Python Standard and DesignScript Libraries
import sys
import clr
clr.AddReference('ProtoGeometry')
from Autodesk.DesignScript.Geometry import *
import urllib.request

# The inputs to this node will be stored as a list in the IN variables.
dataEnteringNode = IN
inputURL = "https://raw.githubusercontent.com/HNANmal/mQ/master/Hdynlib/DataStructure/Dictionary/MergeDictionary.py"

# Place your code below this line
req = urllib.request
data = req.urlopen(inputURL)

result = data.read().decode("utf-8")

# Assign your output to the OUT variable.
OUT = result
# ----------------------------------------
join = List.Join(list0=byKeysValues_2, list1=byKeysValues_3, list2=byKeysValues_4, list3=byKeysValues_5, list4=byKeysValues_6, list5=byKeysValues_7)
merge_dictionary = PythonStringNode(script=string_from_web_2, IN[0]=join)  # CPython3

categories = Categories("OST_Walls")
all_elements_of_category = ElementsOfCategory(Category=categories)
masonWall_Geometry = Python(IN[0]=all_elements_of_category)  # CPython3; frozen
# ---------- masonWall_Geometry.python (13 lines) ----------
# Load the Python Standard and DesignScript Libraries
import sys
import clr
clr.AddReference('ProtoGeometry')
from Autodesk.DesignScript.Geometry import *

# The inputs to this node will be stored as a list in the IN variables.
dataEnteringNode = IN
refs = IN[0]
# Place your code below this line
masonWall = set(map(lambda y: y.Geometry()[0],filter(lambda x: "Block" in x.Name or "Brick" in x.Name, refs)))
# Assign your output to the OUT variable.
OUT = masonWall
# ----------------------------------------

# group: Filtering Level(Room 배치 대상 레벨)
string_from_web_3 = Python()  # CPython3; unwired: IN[0]
# ---------- string_from_web_3.python (19 lines) ----------
# Load the Python Standard and DesignScript Libraries
import sys
import clr
clr.AddReference('ProtoGeometry')
from Autodesk.DesignScript.Geometry import *
import urllib.request

# The inputs to this node will be stored as a list in the IN variables.
dataEnteringNode = IN
inputURL = "https://raw.githubusercontent.com/HNANmal/mQ/master/Hdynlib/Revit/Elements/Filtering/FilterElementsExceptTarget.py"

# Place your code below this line
req = urllib.request
data = req.urlopen(inputURL)

result = data.read().decode("utf-8")

# Assign your output to the OUT variable.
OUT = result
# ----------------------------------------
categories_2 = Categories("OST_Levels")
all_elements_of_category_2 = ElementsOfCategory(Category=categories_2)
n3_지하층_포함여부 = BoolSelector(false)  # "3. 지하층 포함여부"; graph input
code_block_56 = CodeBlock { "B"; }
selectallelementsexcept = PythonStringNode(script=string_from_web_3, IN[0]=all_elements_of_category_2, IN[1]=n3_지하층_포함여부, IN[2]=code_block_56)  # CPython3

# group: All Room Elements
categories_3 = Categories("OST_Rooms")
all_elements_of_category_3 = ElementsOfCategory(Category=categories_3)

# group: Create RoomDS
string_from_web_4 = Python()  # CPython3; unwired: IN[0]
# ---------- string_from_web_4.python (19 lines) ----------
# Load the Python Standard and DesignScript Libraries
import sys
import clr
clr.AddReference('ProtoGeometry')
from Autodesk.DesignScript.Geometry import *
import urllib.request

# The inputs to this node will be stored as a list in the IN variables.
dataEnteringNode = IN
inputURL = "https://raw.githubusercontent.com/HNANmal/mQ/master/Hdynlib/DataStructure/Custom/Rooms/CreateRoomDS.py"

# Place your code below this line
req = urllib.request
data = req.urlopen(inputURL)

result = data.read().decode("utf-8")

# Assign your output to the OUT variable.
OUT = result
# ----------------------------------------
createroomds = PythonStringNode(script=string_from_web_4, IN[0]=selectallelementsexcept, IN[1]=all_elements_of_category_3)  # CPython3
roomDS_objects = CodeBlock(result=createroomds) { result; }

python_script_2 = Python(IN[0]=join)  # CPython3
# ---------- python_script_2.python (22 lines) ----------
# Load the Python Standard and DesignScript Libraries
import sys
import clr
clr.AddReference('ProtoGeometry')
from Autodesk.DesignScript.Geometry import *

# The inputs to this node will be stored as a list in the IN variables.
dataEnteringNode = IN

inputdicts = IN[0]

# Place your code below this line

result = inputdicts[0]
for i in range(len(inputdicts)):
    if i < len(inputdicts)-1:
        result = dict(result, **inputdicts[i+1])
    else:
        pass

# Assign your output to the OUT variable.
OUT = result
# ----------------------------------------

# group: Create SettingsDS
settingsDS = Python(IN[0]=roomDS_objects, IN[1]=python_script_2)  # CPython3
# ---------- settingsDS.python (101 lines) ----------
# Load the Python Standard and DesignScript Libraries
import sys
import clr
clr.AddReference('ProtoGeometry')
from Autodesk.DesignScript.Geometry import *

from itertools import chain

# The inputs to this node will be stored as a list in the IN variables.
dataEnteringNode = IN
inputs = IN[0]
wmdict = IN[1]
    

# Place your code below this line
def main():

    def Create_SettingsDS(roomDS, wmdict):
        def find_WM(finishtype, wmdict):
            result = []
            #result = {}
            if finishtype:
                if finishtype[0] =="":
                    pass
                else:
                    if "WK" in str(finishtype):
                        #result = list(map(lambda x: {"base": wmdict[x]}, finishtype))
                        result = [wmdict[x] for x in finishtype]
                    elif "CL" in str(finishtype):
                        #result = list(map(lambda x: {"ceil": wmdict[x]}, finishtype))
                        result = [wmdict[x] for x in finishtype]
                    elif "IW" in str(finishtype):
                        #result = list(map(lambda x: {"wall": wmdict[x]}, finishtype))
                        result = [wmdict[x] for x in finishtype]
                    elif "FL" in str(finishtype):
                        #result = list(map(lambda x: {"floor": wmdict[x]}, finishtype))
                        result = [wmdict[x] for x in finishtype]
                    elif "RF" in str(finishtype):
                        #result = list(map(lambda x: {"roof": wmdict[x]}, finishtype))
                        result = [wmdict[x] for x in finishtype]
                    elif "EW" in str(finishtype):
                        #result = list(map(lambda x: {"extwall": wmdict[x]}, finishtype))
                        result = [wmdict[x] for x in finishtype]
            else:
                result = []
            return result
            
        name = roomDS["name"]
        roomDS = roomDS
        _baseWM = find_WM(roomDS["basefinish"], wmdict)
        if _baseWM:
            baseWM = _baseWM[0]
        else:
            baseWM = []
        _ceilWM = find_WM(roomDS["ceilfinish"], wmdict)
        if _ceilWM:
            ceilWM = _ceilWM[0]
        else:
            ceilWM = []
        _wallWM = find_WM(roomDS["wallfinish"], wmdict)
        if _wallWM:
            wallWM = _wallWM[0]
        else:
            wallWM = []
        _floorWM = find_WM(roomDS["floorfinish"], wmdict)
        if _floorWM:
            floorWM = _floorWM[0]
        else:
            floorWM = []
        _roofWM = find_WM(roomDS["rooffinish"], wmdict)
        if _roofWM:
            roofWM = _roofWM[0]
        else:
            roofWM = []
        _extwallWM = find_WM(roomDS["extwallfinish"], wmdict)
        if _extwallWM:
            extwallWM = _extwallWM[0]
        else:
            extwallWM = []
        
        result = {
            "name": name,
            "roomDS": roomDS,
            "baseWM": baseWM,
            "ceilWM": ceilWM,
            "wallWM": wallWM,
            "floorWM": floorWM,
            "roofWM": roofWM,
            "extwallWM": extwallWM
        }
        
        return result
        
        
    SettingsDS = [Create_SettingsDS(x, wmdict) for x in inputs]
    
    result = SettingsDS
    return result

# Assign your output to the OUT variable.
OUT = main()
# ----------------------------------------

gettargetforbase = Python()  # CPython3; unwired: IN[0]
# ---------- gettargetforbase.python (22 lines) ----------
# Load the Python Standard and DesignScript Libraries
import sys
import clr
clr.AddReference('ProtoGeometry')
from Autodesk.DesignScript.Geometry import *

# The inputs to this node will be stored as a list in the IN variables.
dataEnteringNode = IN

# Place your code below this line
def getTargetforBase(SettingsDS, WM):
    targets = []
    
    if "Something" in WM:
        pass
    else:
        targets = SettingsDS["roomDS"]["roomperimeter"]
#    targets = SettingsDS["roomDS"]["roomperimeter"]

    return targets
# Assign your output to the OUT variable.
OUT = getTargetforBase
# ----------------------------------------
gettargetforceil = Python()  # CPython3; unwired: IN[0]
# ---------- gettargetforceil.python (21 lines) ----------
# Load the Python Standard and DesignScript Libraries
import sys
import clr
clr.AddReference('ProtoGeometry')
from Autodesk.DesignScript.Geometry import *

# The inputs to this node will be stored as a list in the IN variables.
dataEnteringNode = IN

# Place your code below this line
def getTargetforCeil(SettingsDS, WM):
    targets = []
    
    if "Something" in WM:
        pass
    else:
        targets = SettingsDS["roomDS"]["roomupperface"]

    return targets
# Assign your output to the OUT variable.
OUT = getTargetforCeil
# ----------------------------------------
gettargetforwall = Python()  # CPython3; unwired: IN[0], IN[1]
# ---------- gettargetforwall.python (43 lines) ----------
# Load the Python Standard and DesignScript Libraries
import sys
import clr
clr.AddReference('ProtoGeometry')
from Autodesk.DesignScript.Geometry import *

# The inputs to this node will be stored as a list in the IN variables.
dataEnteringNode = IN

# Place your code below this line
def getTargetforWall(SettingsDS, WM, masonWall):
    targets = []
    
    if "Plaster" in WM:
        for i in SettingsDS["roomDS"]["roomsideface"]:
            tmp = []
            for j in masonWall:
                if i.DoesIntersect(j):
                #if i.DoesIntersect(j.Geometry()[0]):
                    tmp.append(True)
                else:
                    tmp.append(False)
            if any(tmp):
                targets.append(i)
            else:
                pass
    else:
        targets = SettingsDS["roomDS"]["roomsideface"]
#        for i in SettingsDS["roomDS"]["roomsideface"]:
#            tmp = []
#            for j in masonWall:
#                if i.DoesIntersect(j.Geometry()[0]):
#                    tmp.append(False)
#                else:
#                    tmp.append(True)
#            if all(tmp):
#                targets.append(i)
#            else:
#                pass
            
    return targets
# Assign your output to the OUT variable.
OUT = getTargetforWall
# ----------------------------------------
gettargetforfloor = Python()  # CPython3; unwired: IN[0]
# ---------- gettargetforfloor.python (21 lines) ----------
# Load the Python Standard and DesignScript Libraries
import sys
import clr
clr.AddReference('ProtoGeometry')
from Autodesk.DesignScript.Geometry import *

# The inputs to this node will be stored as a list in the IN variables.
dataEnteringNode = IN

# Place your code below this line
def getTargetforFloor(SettingsDS, WM):
    targets = []
    
    if "Something" in WM:
        pass
    else:
        targets = SettingsDS["roomDS"]["roombottomface"]

    return targets
# Assign your output to the OUT variable.
OUT = getTargetforFloor
# ----------------------------------------
gettargetforroof = Python()  # CPython3; unwired: IN[0]
# ---------- gettargetforroof.python (21 lines) ----------
# Load the Python Standard and DesignScript Libraries
import sys
import clr
clr.AddReference('ProtoGeometry')
from Autodesk.DesignScript.Geometry import *

# The inputs to this node will be stored as a list in the IN variables.
dataEnteringNode = IN

# Place your code below this line
def getTargetforRoof(SettingsDS, WM):
    targets = []
    
    if "Something" in WM:
        pass
    else:
        targets = SettingsDS["roomDS"]["roomupperface"]

    return targets
# Assign your output to the OUT variable.
OUT = getTargetforRoof
# ----------------------------------------
gettargetforextwall = Python()  # CPython3; unwired: IN[0], IN[1]
# ---------- gettargetforextwall.python (30 lines) ----------
# Load the Python Standard and DesignScript Libraries
import sys
import clr
clr.AddReference('ProtoGeometry')
from Autodesk.DesignScript.Geometry import *

# The inputs to this node will be stored as a list in the IN variables.
dataEnteringNode = IN
input = IN[0]
#extWall = IN[1]
#refs = IN[1]
#extWall = set(filter(lambda x: "Exterior" in x.Name, refs))
#masonWall = set(filter(lambda x: "Block" in x.Name or "Brick" in x.Name, refs))
#nonMasonWall = set(filter(lambda x: not "Block" in x.Name and not "Brick" in x.Name, refs))

# Place your code below this line
def getTargetforExtWall(SettingsDS, WM, extWall, extWallGeo):
    targets = []
    for i in range(len(extWall)):
        tmp1 = []
        for j in SettingsDS["roomDS"]["disc_line"]:
            if extWallGeo[i].DoesIntersect(j):
                tmp1.append(True)
        if any(tmp1):
            targets.append(extWall[i])
    #targets = [i for i in extWall if any([True for j in SettingsDS["roomDS"]["disc_line"] if i.DoesIntersect(j)])]
    #targets = [i for i in extWall if any([True for j in SettingsDS["roomDS"]["disc_line"] if i.Geometry()[0].DoesIntersect(j)])]
    return targets
# Assign your output to the OUT variable.
OUT = getTargetforExtWall
# ----------------------------------------
python_func_list_join = Python(IN[0]=gettargetforbase, IN[1]=gettargetforceil, IN[2]=gettargetforwall, IN[3]=gettargetforfloor, IN[4]=gettargetforroof, IN[5]=gettargetforextwall)  # CPython3
# ---------- python_func_list_join.python (13 lines) ----------
# Load the Python Standard and DesignScript Libraries
import sys
import clr
clr.AddReference('ProtoGeometry')
from Autodesk.DesignScript.Geometry import *

# The inputs to this node will be stored as a list in the IN variables.
dataEnteringNode = IN

# Place your code below this line

# Assign your output to the OUT variable.
OUT = IN
# ----------------------------------------
calculateValueForWM = Python(IN[0]=settingsDS, IN[1]=all_elements_of_category, IN[2]=python_func_list_join)  # CPython3
# ---------- calculateValueForWM.python (115 lines) ----------
# Load the Python Standard and DesignScript Libraries
import sys
import clr
clr.AddReference('ProtoGeometry')
from Autodesk.DesignScript.Geometry import *

clr.AddReference("RevitNodes")
import Revit

from Revit.Elements import *

clr.AddReference("DSCoreNodes")
from DSCore import *

from itertools import chain

# The inputs to this node will be stored as a list in the IN variables.
dataEnteringNode = IN
inputs = IN[0]
refs = IN[1]
funcs = IN[2]
#masonWall = IN[3]

getTargetforBase = funcs[0]
getTargetforCeil = funcs[1]
getTargetforWall = funcs[2] ##funtion instance
getTargetforFloor = funcs[3]
getTargetforRoof = funcs[4]
getTargetforExtWall = funcs[5] ##funtion instance


walltype = set(map(lambda x: x.Name, refs))
#intWall = set(filter(lambda x: "Interior" in x.Name, refs))
extWall = list(filter(lambda x: "Exterior" in x.Name, refs))
extWallGeo = list(map(lambda y: y.Geometry()[0], filter(lambda x: "Exterior" in x.Name, refs)))
masonWallGeo = list(map(lambda y: y.Geometry()[0], filter(lambda x: "Block" in x.Name or "Brick" in x.Name, refs)))
#nonMasonWall = set(filter(lambda x: not "Block" in x.Name and not "Brick" in x.Name, refs))

def checkValid(value):
    try:
        return value
    except:
        pass

def CalcualteValueForWM(SettingsDS, funcs):

    name = SettingsDS["roomDS"]["name"]
    roomDS = SettingsDS["roomDS"]
    baseWM = SettingsDS["baseWM"]
    ceilWM = SettingsDS["ceilWM"]
    wallWM = SettingsDS["wallWM"]
    floorWM = SettingsDS["floorWM"]
    roofWM = SettingsDS["roofWM"]
    extwallWM = SettingsDS["extwallWM"]
    
    def unitcalc(SettingsDS, WM, finishtype):
        if finishtype == "base": #roomperimeter
            target = getTargetforBase(SettingsDS, WM)
            calcvalue = round(sum(list(map(lambda x: x.Length, target)))/1000,2)
            unit = "M"
        elif finishtype == "ceil":
            target = getTargetforCeil(SettingsDS, WM)
            calcvalue = round(sum(list(map(lambda x: x.Area, target)))/1000000,2)
            unit = "M2"
        elif finishtype == "wall":
            target = getTargetforWall(SettingsDS, WM, masonWallGeo)
            calcvalue = round(sum(list(map(lambda x: x.Area, target)))/1000000,2)
            height = roomDS["roomlimitoffset"]
            unit = "M2"
        elif finishtype == "floor":
            target = getTargetforCeil(SettingsDS, WM)
            calcvalue = round(sum(list(map(lambda x: x.Area, target)))/1000000,2)
            bdlength = sum(list(map(lambda x: x.Length, roomDS["roomperimeter"])))
            unit = "M2"
        elif finishtype == "roof":
            target = getTargetforCeil(SettingsDS, WM)
            calcvalue = round(sum(list(map(lambda x: x.Area, target)))/1000000,2)
            unit = "M2"
        elif finishtype == "extwall":
            target = getTargetforExtWall(SettingsDS, WM, extWall, extWallGeo)
            calcvalue = sum(list(map(lambda x: x.GetParameterValueByName("Area"), target)))
            unit = "M2"
            
        result = []
        result.append(SettingsDS["name"])
        result.append(SettingsDS["roomDS"]["roomelem"].GetParameterValueByName("Department"))
        result.append(finishtype)
#        result.append(WM)
        result.append(WM.split(': ')[0]) ##WM code
        result.append(WM.split(': ')[1]) ##WM description
        result.append(calcvalue)
        result.append(unit)
        if finishtype == "wall":
            result.append(height)
        elif finishtype == "floor":
            result.append(bdlength)
        else:
            pass
            
        return result
    value_base = checkValid(list(map(lambda x: checkValid(unitcalc(SettingsDS, x, "base")), baseWM)))
    value_ceil = checkValid(list(map(lambda x: checkValid(unitcalc(SettingsDS, x, "ceil")), ceilWM)))
    value_wall = checkValid(list(map(lambda x: checkValid(unitcalc(SettingsDS, x, "wall")), wallWM)))
    value_floor = checkValid(list(map(lambda x: checkValid(unitcalc(SettingsDS, x, "floor")), floorWM)))
    value_roof = checkValid(list(map(lambda x: checkValid(unitcalc(SettingsDS, x, "roof")), roofWM)))
    value_extwall = checkValid(list(map(lambda x: checkValid(unitcalc(SettingsDS, x, "extwall")), extwallWM)))
    
    
    return value_base + value_ceil + value_wall + value_floor + value_roof + value_extwall
result = [CalcualteValueForWM(x, funcs) for x in inputs]



# Assign your output to the OUT variable.
OUT = result
# ----------------------------------------
flatten_14 = List.Flatten(list=calculateValueForWM@L2)

# group: Input for Calculation
n4_wet_area_waterproofing_height = DoubleInput(1500)  # "4. Wet Area WaterProofing Height"; graph input
n5_acid_area_resist_height_전체_높이 = DoubleInput(0)  # "5. Acid Area Resist Height(전체 높이 적용일 경우 0 입력)"; graph input
n6_raised_floor_height = DoubleInput(600)  # "6. Raised Floor Height"; graph input

quantity_value_correction = Python(IN[0]=flatten_14, IN[1]=n4_wet_area_waterproofing_height, IN[2]=n5_acid_area_resist_height_전체_높이, IN[3]=n6_raised_floor_height)  # CPython3
# ---------- quantity_value_correction.python (45 lines) ----------
# Load the Python Standard and DesignScript Libraries
import sys
import clr
clr.AddReference('ProtoGeometry')
from Autodesk.DesignScript.Geometry import *

# The inputs to this node will be stored as a list in the IN variables.
dataEnteringNode = IN
inputValues = IN[0]
wfHeight = IN[1]
acidHeight = IN[2]
raisedHeight = IN[3]

# Place your code below this line
def main():

    #walls = list(filter(lambda i: i[2] == "wall", inputValues))
    for i in inputValues:
        if i[2] == "wall":
            if "Waterproof" in i[4]:
                value = i[5] * wfHeight/i[-1]
                i[5]= value
                del i[-1]
            elif "Acid" in i[4]:
                if acidHeight != 0:
                    value = i[5] * acidHeight/i[-1]
                    i[5]= value
                else:
                    pass
                del i[-1]
            else:
                del i[-1]
        elif i[2] == "floor":
            if "Dust" in i[4]:
                value = i[5] + raisedHeight*i[-1]/1000000
                i[5]= value
                del i[-1]
            else:
                del i[-1]
        else:
            pass
    return inputValues

# Assign your output to the OUT variable.
OUT = main()
# ----------------------------------------

# group: Export Excel(By OpenpyXl)
python_script_export_excel_by = Python(IN[0]=quantity_value_correction)  # "Python Script@Export Excel(By OpenpyXl)"; CPython3; frozen
# ---------- python_script_export_excel_by.python (145 lines) ----------
# Load the Python Standard and DesignScript Libraries
import os
python_rootpath = os.getenv('LOCALAPPDATA')+'\Programs\Python'
file_list = os.listdir(python_rootpath)
python_version = file_list[-1]
import sys
sys.path.append(os.getenv('LOCALAPPDATA').replace('\\','\\\\') + f'\Programs\Python\{python_version}\Lib\site-packages')
import clr
clr.AddReference('ProtoGeometry')
from Autodesk.DesignScript.Geometry import *
from collections import Iterable

def iterable(obj):
    return isinstance(obj, Iterable)


# The inputs to this node will be stored as a list in the IN variables.
dataEnteringNode = IN
ListIn = IN[0]

# Place your code below this line
import datetime
from datetime import date, timedelta
Today = date.today()
import openpyxl
from openpyxl.styles import Border, Side, PatternFill, Font, GradientFill, Alignment, Color, numbers

sample_items = ListIn


def write_to_file(filepath):
    wb = openpyxl.Workbook()
    for sheet in wb.sheetnames:
        wb.remove(wb[sheet])

    thin = Side(border_style="thin", color="000000")
    double = Side(border_style="double", color="000000")

    ws = wb.create_sheet(title='Finish Quantities', index=0)

    ws.merge_cells('A1:L1')
    ws['A1'] = 'HEC Bidding Calculation Sheet'
    cell = ws['A1']
    cell.font = openpyxl.styles.Font(color='000000', size=20)
    cell.fill = openpyxl.styles.fills.PatternFill(patternType='solid', fgColor=openpyxl.styles.colors.Color(rgb='fff3b0'))

    ws['A2'] = 'Item Number'
    ws['A2'].font = openpyxl.styles.Font(b=True, color='000000', size=12)
    ws['B2'] = 'Room Name'
    ws['B2'].font = openpyxl.styles.Font(b=True, color='000000', size=12)
    ws['C2'] = 'Department'
    ws['C2'].font = openpyxl.styles.Font(b=True, color='000000', size=12)
#    ws['D2'] = 'Interior Finish Type'
#    ws['D2'].font = openpyxl.styles.Font(b=True, color='000000', size=12)
    ws['D2'] = 'Finish Type'
    ws['D2'].font = openpyxl.styles.Font(b=True, color='000000', size=12)
    ws['E2'] = 'WorkMaster Code'
    ws['E2'].font = openpyxl.styles.Font(b=True, color='000000', size=12)
    ws['F2'] = 'Description'
    ws['F2'].font = openpyxl.styles.Font(b=True, color='000000', size=12)
#    ws['G2'] = '계수'
#    ws['G2'].font = openpyxl.styles.Font(b=True, color='000000', size=12)
#    ws['H2'] = '계산 참조값'
#    ws['H2'].font = openpyxl.styles.Font(b=True, color='000000', size=12)
    ws['G2'] = 'Quantities'
    ws['G2'].font = openpyxl.styles.Font(b=True, color='000000', size=12)
    ws['H2'] = 'Unit'
    ws['H2'].font = openpyxl.styles.Font(b=True, color='000000', size=12)
    ws['I2'] = 'Unit Price'
    ws['I2'].font = openpyxl.styles.Font(b=True, color='000000', size=12)
    ws['J2'] = 'Total Price'
    ws['J2'].font = openpyxl.styles.Font(b=True, color='000000', size=12)


## 칼럼별 너비 조정 구간
#    for col in range(ws.max_column):
#        ws.column_dimensions[chr(ord('A') + col)].width = 15
    ws.column_dimensions['A'].width = 15 ##Item Number
    ws.column_dimensions['B'].width = 25 ##Room
    ws.column_dimensions['C'].width = 12 ##Department
    ws.column_dimensions['D'].width = 12 ##Finish Type
    ws.column_dimensions['E'].width = 20 ##WorkMaster Code
    ws.column_dimensions['F'].width = 52 ##Description
    ws.column_dimensions['G'].width = 9 ##Quantities
    ws.column_dimensions['H'].width = 9 ##Unit
    ws.column_dimensions['I'].width = 12 ##Unit Price
    ws.column_dimensions['J'].width = 12 ##Total Price
#    ws.column_dimensions['G'].hidden = True

###
    start_row = 3
    for (row, item) in enumerate(sample_items, start_row):
        cell = ws.cell(row=row, column=1, value=row - 2)
        cell.alignment = openpyxl.styles.Alignment(horizontal='center', vertical='center')

#        cell = ws.cell(row=row, column=2, value=item[0])
#        cell.number_format = openpyxl.styles.numbers.FORMAT_DATE_YYYYMMDD2  # 'yyyy-mm-dd'
        ws.cell(row=row, column=2, value=item[0]) ## Room Name 칼럼

        ws.cell(row=row, column=3, value=item[1]) ## Department 칼럼
        
        ws.cell(row=row, column=4, value=item[2]) ## Department 칼럼
        
        ws.cell(row=row, column=5, value=item[3]) ## WorkMaster Code 칼럼
        
        ws.cell(row=row, column=6, value=item[4]) ## WorkMaster Description 칼럼
        
        cell = ws.cell(row=row, column=7, value=item[5]) ## Quantities 칼럼
        cell.number_format = '#.##'
#        cell.number_format = openpyxl.styles.numbers.builtin_format_code(3)  # '#,##0'
        cell.font = openpyxl.styles.Font(b=True, color='000000', size=11)
        
        ws.cell(row=row, column=8, value=item[6]) ## Unit 칼럼

        cell = ws.cell(row=row, column=10, value='= G{current_row}*I{current_row}'.format(current_row=cell.row))
        cell.number_format = '#.##'

#        cell = ws.cell(row=row, column=6, value='= D{current_row} * E{current_row}'.format(current_row=cell.row))
#        cell.number_format = openpyxl.styles.numbers.builtin_format_code(3)

    total_row = ws.max_row + 1
    if total_row > start_row:
        cell1 = ws.cell(row=total_row, column=9, value='Total')
        cell1.font = openpyxl.styles.Font(b=True, color='000000', size=15)
        
        cell2 = ws.cell(row=total_row, column=10, value='= SUM(J{}:J{})'.format(start_row, total_row - 1))
        cell2.number_format = '#.##'#openpyxl.styles.numbers.builtin_format_code(3)
        cell2.border = Border(top=double, left=double, right=double, bottom=double)
        cell2.font = openpyxl.styles.Font(b=True, color='ff03ce', size=15)
    

    wb.save(filepath)
    wb.close()


##if __name__ == '__main__':
#write_to_file('C:\\Users\\pjmk0\\AppData\\Roaming\\test.xlsx')
save_name = "HecBiddingCalcSheet_" + Today.strftime("%Y-%m-%d")+".xlsx"
path = os.getenv('APPDATA').replace('\\','\\\\')
filePath = path + '\\' + save_name

write_to_file(filePath)

# Assign your output to the OUT variable.
OUT = os.getenv('APPDATA')
# ----------------------------------------

code_block_57 = CodeBlock { "*"; }
find_identifier_row_idx = Python(IN[0]=python_script, IN[1]=code_block_57)  # CPython3
# ---------- find_identifier_row_idx.python (37 lines) ----------
# Load the Python Standard and DesignScript Libraries
import sys
import clr
clr.AddReference('ProtoGeometry')
from Autodesk.DesignScript.Geometry import *
from functools import reduce

# The inputs to this node will be stored as a list in the IN variables.
dataEnteringNode = IN

input = IN[0]
idf = IN[1]
# Place your code below this line

def find_tgrow_idx(tglst, idf, mode):
    if mode == "sttwith":
        def chck_identifier(x, idf):
            eres = str(x).startswith("['" + idf)
            return eres
            
    elif mode == "incld":
        def chck_identifier(x, idf):
            eres = str(x).find(idf)
            if eres >= 0:
                return True
            else:
                return False
        
    
    bln_res = list(map(lambda x: chck_identifier(x,idf), tglst))
    result = [i for i, x in enumerate(bln_res) if x]
    return result


result = find_tgrow_idx(input, idf, "sttwith")
# Assign your output to the OUT variable.
OUT = result
# ----------------------------------------
code_block_58 = CodeBlock { 0; }
splitdataasdict_불필요null_제거 = Python(IN[0]=python_script, IN[1]=find_identifier_row_idx, IN[2]=code_block_58)  # CPython3
# ---------- splitdataasdict_불필요null_제거.python (72 lines) ----------
# Load the Python Standard and DesignScript Libraries
import sys
import clr
clr.AddReference('ProtoGeometry')
from Autodesk.DesignScript.Geometry import *
from functools import reduce

curry = lambda f: lambda a,*args: f(a, *args) if (len(args)) else lambda *args: f(a, *args)

add = curry(lambda a,b: a + b)

filter = curry(filter)
map = curry(map)

def _take(length, iter):
    res = []
    for a in iter:
        res.append(a)
        if len(res) == length:
            return res
take = curry(_take)
reduce = curry(reduce)
go = lambda *args: reduce(lambda a,f: f(a), args)

def checkAllElement(list, target):
    tmp=[]
    for i in list:
        if i == target:
            tmp.append(True)
        else:
            tmp.append(False)
    return all(tmp)

rm_Null = lambda list: go(list,
    filter(lambda a: not checkAllElement(a, None)),
    )

# The inputs to this node will be stored as a list in the IN variables.
dataEnteringNode = IN

input = IN[0]
split_idx = IN[1]
key_idx = IN[2]

# Place your code below this line
def splitDataAsDict(split_idx, data, key_idx):

    def calc_range(split_idx):
        res = []
        for i,x in enumerate(split_idx):
            if i < len(split_idx)-1:
                res.append((x, split_idx[i+1]))
            else:
                res.append((x, len(input)))
        return res
    
    range = calc_range(split_idx)

    result = []
    dic = {}
    for x in range:
        key = str(data[x[0]][key_idx+1]).split('    ;')[0]
        val1 = data[x[0]+1:x[1]]
        val_tr = list(zip(*val1))
        val = list(zip(*rm_Null(val_tr)))
        dic[str(key)] = val
    return dic

result = splitDataAsDict(split_idx, input, key_idx)

# Assign your output to the OUT variable.
OUT = result
# ----------------------------------------
