# Dynamo graph 2-1_Room Separator(221201).dyn (Dynamo 2.13.1.3887)

code_block = CodeBlock { {}; }
code_block_2 = CodeBlock { "box obj"; }

# group: Generic Mass & Level select
categories = Categories("OST_GenericModel")
all_elements_of_category = ElementsOfCategory(Category=categories)

string_from_object = FromObject(object=all_elements_of_category)
code_block_3 = CodeBlock { "Space Planning Box"; }
contains = String.Contains(string=string_from_object, searchFor=code_block_3)
filterByBoolMask = List.FilterByBoolMask(list=all_elements_of_category, mask=contains)

# group: get obj
# set Dictionary
mkNewDicts = Python(IN[0]=code_block, IN[1]=code_block_2, IN[2]=filterByBoolMask.in)  # CPython3
# ---------- mkNewDicts.python (32 lines) ----------
# Load the Python Standard and DesignScript Libraries
import sys
import clr
clr.AddReference('ProtoGeometry')
from Autodesk.DesignScript.Geometry import *

# The inputs to this node will be stored as a list in the IN variables.
dataEnteringNode = IN

preDicts = IN[0]
newKey = IN[1]
newValues = IN[2]

# Place your code below this line

def mkNewDicts(preDicts, newKey, newValues):
    if preDicts == {}:
        preDicts = []
        list(map(lambda x: preDicts.append({}), newValues))
    else:
        pass

    dict_valuePairs = zip(preDicts, newValues)
    
    def mkNewDict(_dict, _key, _value):
        _dict[_key] = _value
        return _dict
    
    result = map(lambda x: mkNewDict(x[0], newKey, x[1]), dict_valuePairs)
    return result
# Assign your output to the OUT variable.
OUT = mkNewDicts(preDicts, newKey, newValues)
# ----------------------------------------

code_block_4 = CodeBlock(d=mkNewDicts) { d; }
code_block_5 = CodeBlock { "box_roomName"; }
code_block_6 = CodeBlock { "box obj"; }
valueAtKey = DesignScript.Builtin.Dictionary.ValueAtKey(dictionary=code_block_4, key=code_block_6)
code_block_7 = CodeBlock { "Room Name"; }
getParameterValueByName = Element.GetParameterValueByName(element=valueAtKey, parameterName=code_block_7)

# group: box_roomName 추출
# set Dictionary
mkNewDicts_2 = Python(IN[0]=code_block_4, IN[1]=code_block_5, IN[2]=getParameterValueByName)  # CPython3; same code as mkNewDicts

code_block_8 = CodeBlock(d=mkNewDicts_2) { d; }
code_block_9 = CodeBlock { "box obj"; }
valueAtKey_2 = DesignScript.Builtin.Dictionary.ValueAtKey(dictionary=code_block_8, key=code_block_9)
code_block_10 = CodeBlock { "Level"; }
getParameterValueByName_2 = Element.GetParameterValueByName(element=valueAtKey_2, parameterName=code_block_10)
string_from_object_2 = FromObject(object=getParameterValueByName_2)
code_block_11 = CodeBlock { {}; }
code_block_12 = CodeBlock { "used viewObj"; }
code_block_13 = CodeBlock { {}; }
code_block_14 = CodeBlock { "used viewObj"; }
code_block_15 = CodeBlock { "box lv"; }
name = Level.Name(level=getParameterValueByName_2)

# group: box level추출
# set Dictionary
mkNewDicts_3 = Python(IN[0]=code_block_8, IN[1]=code_block_15, IN[2]=name)  # CPython3; same code as mkNewDicts

code_block_16 = CodeBlock(d=mkNewDicts_3) { d; }
code_block_17 = CodeBlock { "box lv"; }
valueAtKey_3 = DesignScript.Builtin.Dictionary.ValueAtKey(dictionary=code_block_16, key=code_block_17)

# group: 사용된 뷰 필터링 알고리즘
categories_2 = Categories("OST_Views")
all_elements_of_category_2 = ElementsOfCategory(Category=categories_2)
boolean = BoolSelector(false)
clean = List.Clean(list=all_elements_of_category_2, preserveIndices=boolean)
string_from_object_3 = FromObject(object=clean)
code_block_18 = CodeBlock { "FloorPlanView"; }
contains_2 = String.Contains(string=string_from_object_3, searchFor=code_block_18, lacing=CrossProduct)
filterByBoolMask_2 = List.FilterByBoolMask(list=clean, mask=contains_2)
name_2 = Element.Name(element=filterByBoolMask_2.in)
uniqueItems = List.UniqueItems(list=valueAtKey_3)
contains_3 = String.Contains(string=name_2, searchFor=uniqueItems, lacing=CrossProduct)
anyTrue = List.AnyTrue(list=contains_3@L2)
filterByBoolMask_3 = List.FilterByBoolMask(list=filterByBoolMask_2.in, mask=anyTrue)

# group: get obj
# set Dictionary
mkNewDicts_4 = Python(IN[0]=code_block_13, IN[1]=code_block_14, IN[2]=filterByBoolMask_3.in)  # CPython3; same code as mkNewDicts

code_block_19 = CodeBlock(d=mkNewDicts_4) { d; }
code_block_20 = CodeBlock { "used viewObj"; }
valueAtKey_4 = DesignScript.Builtin.Dictionary.ValueAtKey(dictionary=code_block_19, key=code_block_20)

# group: 사용 뷰 추출
# set Dictionary
mkNewDicts_5 = Python(IN[0]=code_block_11, IN[1]=code_block_12, IN[2]=valueAtKey_4)  # CPython3; same code as mkNewDicts

code_block_21 = CodeBlock { "sketchPlane"; }
code_block_22 = CodeBlock(d=mkNewDicts_3) { d; }
code_block_23 = CodeBlock { "box cenPoint"; }
code_block_24 = CodeBlock { "box obj"; }
valueAtKey_5 = DesignScript.Builtin.Dictionary.ValueAtKey(dictionary=code_block_22, key=code_block_24)
getLocation = Element.GetLocation(element=valueAtKey_5)

# group: box 기준점 추출
# set Dictionary
mkNewDicts_6 = Python(IN[0]=code_block_22, IN[1]=code_block_23, IN[2]=getLocation)  # CPython3; same code as mkNewDicts

code_block_25 = CodeBlock(d=mkNewDicts_6) { d; }
code_block_26 = CodeBlock { "box refPlane"; }
code_block_27 = CodeBlock { "box cenPoint"; }
valueAtKey_6 = DesignScript.Builtin.Dictionary.ValueAtKey(dictionary=code_block_25, key=code_block_27)
byOriginNormal = Plane.ByOriginNormal(origin=valueAtKey_6)

# group: box 작업평면 추출
# set Dictionary
mkNewDicts_7 = Python(IN[0]=code_block_25, IN[1]=code_block_26, IN[2]=byOriginNormal)  # CPython3; same code as mkNewDicts

code_block_28 = CodeBlock(d=mkNewDicts_7) { d; }
code_block_29 = CodeBlock { "box btmSrf"; }
code_block_30 = CodeBlock { "box refPlane"; }
valueAtKey_7 = DesignScript.Builtin.Dictionary.ValueAtKey(dictionary=code_block_28, key=code_block_30)
code_block_31 = CodeBlock { "box obj"; }
valueAtKey_8 = DesignScript.Builtin.Dictionary.ValueAtKey(dictionary=code_block_28, key=code_block_31)
geometry = Element.Geometry(element=valueAtKey_8)
intersect = Geometry.Intersect(geometry=valueAtKey_7, other=geometry, lacing=Shortest)
flatten = List.Flatten(list=intersect)

# group: box 하부면 추출
# set Dictionary
mkNewDicts_8 = Python(IN[0]=code_block_28, IN[1]=code_block_29, IN[2]=flatten)  # CPython3; same code as mkNewDicts

code_block_32 = CodeBlock(d=mkNewDicts_8) { d; }
code_block_33 = CodeBlock { "box btmEdgeCrv"; }
code_block_34 = CodeBlock { "box btmSrf"; }
valueAtKey_9 = DesignScript.Builtin.Dictionary.ValueAtKey(dictionary=code_block_32, key=code_block_34)
perimeterCurves = Surface.PerimeterCurves(surface=valueAtKey_9)

# group: 매스별 바운더리 라인 추출
# set Dictionary
mkNewDicts_9 = Python(IN[0]=code_block_32, IN[1]=code_block_33, IN[2]=perimeterCurves)  # CPython3; same code as mkNewDicts

code_block_35 = CodeBlock(d=mkNewDicts_9) { d; }

# group: corridor box 다중 생성시 대응 구간
code_block_36 = CodeBlock { "Corridor"; }
code_block_37 = CodeBlock(d=code_block_35, n=code_block_36) { d["box_roomName"] == n; }
filterByBoolMask_4 = List.FilterByBoolMask(list=code_block_35, mask=code_block_37)
code_block_38 = CodeBlock(d_noCorridor=filterByBoolMask_4.out) { d_noCorridor; }
code_block_39 = CodeBlock(d_corridor=filterByBoolMask_4.in) { d_corridor; }
code_block_40 = CodeBlock(d=code_block_39) { d; }
code_block_41 = CodeBlock { "box btmEdgeCrv"; }
valueAtKey_10 = DesignScript.Builtin.Dictionary.ValueAtKey(dictionary=code_block_40, key=code_block_41)
code_block_42 = CodeBlock { "box lv"; }
valueAtKey_11 = DesignScript.Builtin.Dictionary.ValueAtKey(dictionary=code_block_40, key=code_block_42)
groupByKey = List.GroupByKey(list=valueAtKey_10, keys=valueAtKey_11)
flatten_2 = List.Flatten(list=groupByKey.groups@L3)
byKeysValues = DesignScript.Builtin.Dictionary.ByKeysValues(keys=groupByKey.uniqueKeys, values=flatten_2)
code_block_43 = CodeBlock { "box lv"; }
valueAtKey_12 = DesignScript.Builtin.Dictionary.ValueAtKey(dictionary=code_block_39, key=code_block_43)
uniqueItems_2 = List.UniqueItems(list=valueAtKey_12)
code_block_44 = CodeBlock(k=uniqueItems_2) { k; }
valueAtKey_13 = DesignScript.Builtin.Dictionary.ValueAtKey(dictionary=byKeysValues, key=code_block_44)
code_block_45 = CodeBlock(d=code_block_35) { d; }
code_block_46 = CodeBlock { "box btmSrf"; }
valueAtKey_14 = DesignScript.Builtin.Dictionary.ValueAtKey(dictionary=code_block_45, key=code_block_46)
code_block_47 = CodeBlock { "box lv"; }
valueAtKey_15 = DesignScript.Builtin.Dictionary.ValueAtKey(dictionary=code_block_45, key=code_block_47)
groupByKey_2 = List.GroupByKey(list=valueAtKey_14, keys=valueAtKey_15)
byKeysValues_2 = DesignScript.Builtin.Dictionary.ByKeysValues(keys=groupByKey_2.uniqueKeys, values=groupByKey_2.groups)
valueAtKey_16 = DesignScript.Builtin.Dictionary.ValueAtKey(dictionary=byKeysValues_2, key=uniqueItems_2)
byUnion = Surface.ByUnion(surfaces=valueAtKey_16)
makeOffsetSrfs = Python(IN[0]=byUnion)  # CPython3
# ---------- makeOffsetSrfs.python (20 lines) ----------
# Load the Python Standard and DesignScript Libraries
import sys
import clr
clr.AddReference('ProtoGeometry')
from Autodesk.DesignScript.Geometry import *

# The inputs to this node will be stored as a list in the IN variables.
dataEnteringNode = IN
srfs = IN[0]
offsetValue = -100
# Place your code below this line
def makeOffsetSrfs(srfs, offsetValue):
    periCrvs = map(Surface.PerimeterCurves, srfs)
    offsetPolyCrvs = map(lambda x: Curve.Offset(PolyCurve.ByJoinedCurves(x), offsetValue), periCrvs)
    offsetSrfs = map(Surface.ByPatch, offsetPolyCrvs)
    
    return offsetSrfs

# Assign your output to the OUT variable.
OUT = makeOffsetSrfs(srfs, offsetValue)
# ----------------------------------------
byKeysValues_3 = DesignScript.Builtin.Dictionary.ByKeysValues(keys=uniqueItems_2, values=makeOffsetSrfs)
valueAtKey_17 = DesignScript.Builtin.Dictionary.ValueAtKey(dictionary=byKeysValues_3, key=code_block_44)
doesIntersect = Geometry.DoesIntersect(geometry=valueAtKey_17, other=valueAtKey_13, lacing=Shortest)
filterByBoolMask_5 = List.FilterByBoolMask(list=valueAtKey_13, mask=doesIntersect)

code_block_48 = CodeBlock(d_noCorridor=code_block_38) { d_noCorridor; }
code_block_49 = CodeBlock { "box btmEdgeCrv"; }

# group: 매스별 바운더리 라인 추출
# set Dictionary
mkNewDicts_10 = Python(IN[0]=code_block_39, IN[1]=code_block_49, IN[2]=filterByBoolMask_5.out)  # CPython3; same code as mkNewDicts

join = List.Join(list0=code_block_48, list1=mkNewDicts_10)
code_block_50 = CodeBlock(d=join) { d; }
code_block_51 = CodeBlock { "box refPlane"; }
valueAtKey_18 = DesignScript.Builtin.Dictionary.ValueAtKey(dictionary=code_block_50, key=code_block_51)
code_block_52 = CodeBlock { "box lv"; }
valueAtKey_19 = DesignScript.Builtin.Dictionary.ValueAtKey(dictionary=code_block_50, key=code_block_52)
groupByKey_3 = List.GroupByKey(list=valueAtKey_18, keys=valueAtKey_19)
firstItem = List.FirstItem(list=groupByKey_3.groups@L2)
byPlane = SketchPlane.ByPlane(plane=firstItem)

# group: 작업평면 추출
# set Dictionary
mkNewDicts_11 = Python(IN[0]=mkNewDicts_5, IN[1]=code_block_21, IN[2]=byPlane)  # CPython3; same code as mkNewDicts

code_block_53 = CodeBlock { "separationCrv"; }
code_block_54 = CodeBlock { "box btmEdgeCrv"; }
valueAtKey_20 = DesignScript.Builtin.Dictionary.ValueAtKey(dictionary=code_block_50, key=code_block_54)
groupByKey_4 = List.GroupByKey(list=valueAtKey_20, keys=valueAtKey_19)
flatten_3 = List.Flatten(list=groupByKey_4.groups@L3)

# group: 작업평면 추출
# set Dictionary
mkNewDicts_12 = Python(IN[0]=mkNewDicts_11, IN[1]=code_block_53, IN[2]=flatten_3)  # CPython3; same code as mkNewDicts

code_block_55 = CodeBlock(d=mkNewDicts_12) { d["separationCrv"]; d["sketchPlane"]; d["used viewObj"]; }
# note: RoomSeparator.FromCurve
python_script = Python(IN[0]=code_block_55.out0, IN[1]=code_block_55.out1, IN[2]=code_block_55.out2)  # CPython3
# ---------- python_script.python (51 lines) ----------
import clr
clr.AddReference('RevitAPI')
from Autodesk.Revit.DB import *

clr.AddReference("RevitNodes")
import Revit
clr.ImportExtensions(Revit.GeometryConversion)

clr.AddReference("RevitServices")
import RevitServices
from RevitServices.Persistence import DocumentManager
from RevitServices.Transactions import TransactionManager

doc = DocumentManager.Instance.CurrentDBDocument
curveslist = UnwrapElement(IN[0])
sketchplaneslist = UnwrapElement(IN[1])
viewslist = UnwrapElement(IN[2])

def createRoomSeparator(curves, sketchplane, view):
    curvearray = CurveArray()
    for curve in curves:
    	curvearray.Append(curve.ToRevitType())
    doccreation = doc.Create
    separatorarray = doccreation.NewRoomBoundaryLines(sketchplane, curvearray, view)
    elementlist = []
    for item in separatorarray:
    	elementlist.append(item)
    
    return elementlist


TransactionManager.Instance.EnsureInTransaction(doc)

if len(curveslist) > 1:
    result = []
    for i in range(len(curveslist)):
        uni = createRoomSeparator(curveslist[i], sketchplaneslist[i], viewslist[i])
        result.append(uni)
else:
    result = createRoomSeparator(curveslist, sketchplaneslist, viewslist)

#result = createRoomSeparator(curveslist, sketchplaneslist, viewslist)

TransactionManager.Instance.TransactionTaskDone()
    





OUT = result
# ----------------------------------------
createseparator_result = Watch(python_script)  # graph output
final_function_s_argment_check = Watch(mkNewDicts_12)  # graph output
대상_객체_필터링 = Watch(filterByBoolMask.in)  # graph output
