# Dynamo graph 2-2_Draft Room Generating(221201).dyn (Dynamo 2.13.1.3887)

# group: Room 자동 생성 구간
select_phase = RevitPhases("New Construction")  # graph input
python_script_rooms_place = Python(IN[0]=select_phase)  # "Python Script@Rooms place automatically for all levels"; CPython3; frozen
# ---------- python_script_rooms_place.python (49 lines) ----------
import clr

clr.AddReference("RevitServices")
import RevitServices
from RevitServices.Persistence import DocumentManager
from RevitServices.Transactions import TransactionManager
doc = DocumentManager.Instance.CurrentDBDocument

clr.AddReference("RevitAPI")
import Autodesk
from Autodesk.Revit.DB import *

clr.AddReference("RevitNodes")
import Revit
clr.ImportExtensions(Revit.Elements)
clr.ImportExtensions(Revit.GeometryConversion)

collector = FilteredElementCollector(doc)
levels = collector.OfClass(Level).ToElements()

phase = UnwrapElement(IN[0])
limitoffset = 8
listout = []

for j,level in enumerate(levels):
	try:
		planTopology = doc.get_PlanTopology(level)
		rooms = []
		
		for i,plancircuit in enumerate(planTopology.Circuits):
			if plancircuit.IsRoomLocated == True:
				continue
			TransactionManager.Instance.EnsureInTransaction(doc)
			room = doc.Create.NewRoom(phase)
			room.Name = "Name" + str(i)
			room.Number = str(j) + "." + str(i)
			room.LimitOffset = limitoffset
			try:
				room2 = doc.Create.NewRoom(room,plancircuit)
			except:
				continue
			TransactionManager.Instance.TransactionTaskDone()
			rooms.append(room2)
		listout.append(rooms)
	except:
		continue


OUT = listout
# ----------------------------------------

watch = Watch(python_script_rooms_place)

# group: 가명칭 부여
flatten = List.Flatten(list=watch)
code_block = CodeBlock { "Name"; }
code_block_2 = CodeBlock { "a"; }
setParameterByName = Element.SetParameterByName(element=flatten, parameterName=code_block, value=code_block_2)

getplantopology_for_all_levels = Python()  # CPython3
# ---------- getplantopology_for_all_levels.python (32 lines) ----------
import clr

clr.AddReference("RevitServices")
import RevitServices
from RevitServices.Persistence import DocumentManager
from RevitServices.Transactions import TransactionManager
doc = DocumentManager.Instance.CurrentDBDocument

clr.AddReference("RevitAPI")
import Autodesk
from Autodesk.Revit.DB import *

clr.AddReference("RevitNodes")
import Revit
clr.ImportExtensions(Revit.Elements)
clr.ImportExtensions(Revit.GeometryConversion)

collector = FilteredElementCollector(doc)
levels = collector.OfClass(Level).ToElements()


limitoffset = 8

def getPlanTopo_AllLevs():
    
    TransactionManager.Instance.EnsureInTransaction(doc)
    planTopology = map(lambda x: doc.get_PlanTopology(x), levels)
    TransactionManager.Instance.TransactionTaskDone()
    
    return planTopology

OUT = (levels, getPlanTopo_AllLevs())
# ----------------------------------------
python_script_rooms_place_2 = Python(IN[0]=select_phase, IN[1]=getplantopology_for_all_levels)  # "Python Script@Rooms place automatically for all levels"; CPython3
# ---------- python_script_rooms_place_2.python (53 lines) ----------
import clr

clr.AddReference("RevitServices")
import RevitServices
from RevitServices.Persistence import DocumentManager
from RevitServices.Transactions import TransactionManager
doc = DocumentManager.Instance.CurrentDBDocument

clr.AddReference("RevitAPI")
import Autodesk
from Autodesk.Revit.DB import *

clr.AddReference("RevitNodes")
import Revit
clr.ImportExtensions(Revit.Elements)
clr.ImportExtensions(Revit.GeometryConversion)

collector = FilteredElementCollector(doc)
#levels = collector.OfClass(Level).ToElements()

phase = UnwrapElement(IN[0])
limitoffset = 8

(levels, planTopologys) = IN[1]

def createNewRooms(phase, levels, planTopologys):
    listout = []
    for j,level in enumerate(levels):
    	try:
    		planTopology = planTopologys[j]
    		rooms = []
    
    		for i,plancircuit in enumerate(planTopology.Circuits):
    			if plancircuit.IsRoomLocated == True:
    				continue
    			TransactionManager.Instance.EnsureInTransaction(doc)
    			room = doc.Create.NewRoom(phase)
    			room.Name = "a"
    			room.Number = str(j) + "." + str(i)
    			room.LimitOffset = limitoffset
    			try:
    				room2 = doc.Create.NewRoom(room,plancircuit)
    			except:
    				continue
    			TransactionManager.Instance.TransactionTaskDone()
    			rooms.append(room2)
    		listout.append(rooms)
    	except:
    		continue
    return listout


OUT = createNewRooms(phase, levels, planTopologys)
# ----------------------------------------
