# Dynamo graph 2-3_Room with Param Generating(1218).dyn (Dynamo 2.10.1.3976)

# group: 모든 룸 불러오기 + Level 별 정렬
categories = Categories("OST_Rooms")
all_elements_of_category = ElementsOfCategory(Category=categories)
code_block = CodeBlock { "Level"; }
getParameterValueByName = Element.GetParameterValueByName(element=all_elements_of_category, parameterName=code_block)
uniqueItems = List.UniqueItems(list=getParameterValueByName)
allIndicesOf = List.AllIndicesOf(list=getParameterValueByName, item=uniqueItems)
getItemAtIndex = List.GetItemAtIndex(list=all_elements_of_category, index=allIndicesOf)
byKeysValues = DesignScript.Builtin.Dictionary.ByKeysValues(keys=uniqueItems, values=getItemAtIndex)

# group: 모든 Generic Box 불러오기
code_block_2 = CodeBlock(levelFromRoom=uniqueItems) { levelFromRoom; }
categories_2 = Categories("OST_GenericModel")
all_elements_of_category_2 = ElementsOfCategory(Category=categories_2)
name = Element.Name(element=all_elements_of_category_2)
code_block_3 = CodeBlock { "Space Planning Box"; }
contains = String.Contains(str=name, searchFor=code_block_3)
filterByBoolMask = List.FilterByBoolMask(list=all_elements_of_category_2, mask=contains)
code_block_4 = CodeBlock { "Level"; }
getParameterValueByName_2 = Element.GetParameterValueByName(element=filterByBoolMask.in, parameterName=code_block_4)
name_2 = Level.Name(level=getParameterValueByName_2)
contains_2 = String.Contains(str=name_2, searchFor=code_block_2@L1)
code_block_5 = CodeBlock { true; }
allIndicesOf_2 = List.AllIndicesOf(list=contains_2@L2, item=code_block_5)
getItemAtIndex_2 = List.GetItemAtIndex(list=filterByBoolMask.in, index=allIndicesOf_2)
byKeysValues_2 = DesignScript.Builtin.Dictionary.ByKeysValues(keys=code_block_2, values=getItemAtIndex_2)

# group: Box 중 "Corridor Box" 분리
code_block_6 = CodeBlock(input=byKeysValues_2) { input; }
components = DesignScript.Builtin.Dictionary.Components(dictionary=code_block_6)
code_block_7 = CodeBlock(i=components.values) { i; }
code_block_8 = CodeBlock { "Room Name"; }
getParameterValueByName_3 = Element.GetParameterValueByName(element=code_block_7, parameterName=code_block_8)
string_from_object = FromObject(object=getParameterValueByName_3)
code_block_9 = CodeBlock { "Corridor"; }
contains_3 = String.Contains(str=string_from_object, searchFor=code_block_9)
filterByBoolMask_2 = List.FilterByBoolMask(list=code_block_7, mask=contains_3)
byKeysValues_3 = DesignScript.Builtin.Dictionary.ByKeysValues(keys=components.keys, values=filterByBoolMask_2.in)

# group: Corridor 존재 층
anyTrue = List.AnyTrue(list=contains_3@L2)
code_block_10 = CodeBlock { true; }
allIndicesOf_3 = List.AllIndicesOf(list=anyTrue, item=code_block_10)
getItemAtIndex_3 = List.GetItemAtIndex(list=components.keys, index=allIndicesOf_3)

# group: Corridor 제외 Box 레벨별 딕셔너리 생성
byKeysValues_4 = DesignScript.Builtin.Dictionary.ByKeysValues(keys=components.keys, values=filterByBoolMask_2.out)
box_noCorridor = CodeBlock(i=byKeysValues_4) { i; }

# group: 룸 형상화 및 중점 추출
code_block_11 = CodeBlock(input=byKeysValues) { input; }
components_2 = DesignScript.Builtin.Dictionary.Components(dictionary=code_block_11)
geometry = Element.Geometry(element=components_2.values)
flatten = List.Flatten(list=geometry@L3)
byKeysValues_5 = DesignScript.Builtin.Dictionary.ByKeysValues(keys=components_2.keys, values=flatten)
centroid = Solid.Centroid(solid=flatten)
byKeysValues_6 = DesignScript.Builtin.Dictionary.ByKeysValues(keys=components_2.keys, values=centroid)
output = CodeBlock(Key_level=components_2.keys, RoomElem=code_block_11, RoomSolid=byKeysValues_5, RoomCentroid=byKeysValues_6, BoxTotal=byKeysValues_2, corridorFloor=getItemAtIndex_3, Boxcorridor=byKeysValues_3, Box_noCorridor=box_noCorridor)
# ---------- output.designscript (10 lines) ----------
box = {
"Key_level": Key_level,
"RoomElem": RoomElem,
"RoomSolid": RoomSolid,
"RoomCentroid": RoomCentroid,
"BoxTotal": BoxTotal,
"corridorFloor": corridorFloor,
"Boxcorridor": Boxcorridor,
"Box_noCorridor": Box_noCorridor
};
# ----------------------------------------

# group: Corridor에 해당하는 Room 객체 찾고 매개변수 입력
input = CodeBlock(input=output)
# ---------- input.designscript (8 lines) ----------
input;
input["Key_level"];
input["RoomElem"];
input["RoomSolid"];
input["RoomCentroid"];
input["BoxTotal"];
input["corridorFloor"];
input["Boxcorridor"];
# ----------------------------------------
code_block_12 = CodeBlock { "Name"; "Department"; "Interior Finish"; "Exterior Finish"; "Limit Offset"; }
join = List.Join(list0=code_block_12.out0, list1=code_block_12.out1, list2=code_block_12.out2, list3=code_block_12.out3, list4=code_block_12.out4)
python_script_find_corridor = Python(IN[1]=input.out1, IN[2]=input.out2, IN[3]=input.out3, IN[4]=input.out4, IN[5]=input.out5, IN[6]=input.out6)  # CPython3; unwired: IN[0]
# ---------- python_script_find_corridor.python (36 lines) ----------
# Load the Python Standard and DesignScript Libraries
import sys
import clr
clr.AddReference('ProtoGeometry')
from Autodesk.DesignScript.Geometry import *

# The inputs to this node will be stored as a list in the IN variables.
dataEnteringNode = IN

Key_level = IN[1]
RoomElem = IN[2]
RoomSolid = IN[3]
RoomCentroid = IN[4]
Box_Total = IN[5]
corridorFloor = IN[6]
# Place your code below this line
corridorIndex = {}
for i in corridorFloor:
    tmp1 = []
    for j in RoomCentroid[i]:
        tmp2 = []
        for k in Box_Total[i]:
            if len(Box_Total[i]) > 0:
                bln = j.DoesIntersect(k.Geometry()[0])
                if bln == True:
                    tmp2.append(bln)
            else:
                pass
        if len(tmp2) == 1:
            idx = RoomCentroid[i].index(j)
            tmp1.append(RoomElem[i][idx])
    corridorIndex[i] = tmp1


# Assign your output to the OUT variable.
OUT = corridorIndex
# ----------------------------------------
valueAtKey = DesignScript.Builtin.Dictionary.ValueAtKey(dictionary=input.out7, key=input.out6)
code_block_13 = CodeBlock { "Room Name"; "Department"; "Interior Finish"; "Exterior Finish"; "ceiling height"; }
join_2 = List.Join(list0=code_block_13.out0, list1=code_block_13.out1, list2=code_block_13.out2, list3=code_block_13.out3, list4=code_block_13.out4)
getParameterValueByName_4 = Element.GetParameterValueByName(element=valueAtKey, parameterName=join_2, lacing=CrossProduct)
flatten_2 = List.Flatten(list=getParameterValueByName_4@L3)
byKeysValues_7 = DesignScript.Builtin.Dictionary.ByKeysValues(keys=input.out6, values=flatten_2)
python_script_element = Python(IN[0]=input.out7, IN[1]=join, IN[2]=python_script_find_corridor, IN[3]=byKeysValues_7, IN[4]=input.out6)  # "Python Script@Element.SetParameterByName"; CPython3
# ---------- python_script_element.python (49 lines) ----------
# Load the Python Standard and DesignScript Libraries
import sys
import clr
clr.AddReference('ProtoGeometry')
from Autodesk.DesignScript.Geometry import *

# The inputs to this node will be stored as a list in the IN variables.
dataEnteringNode = IN

BoxcorridorDict = IN[0]
parameterNameList = IN[1]
elementDict = IN[2]
parameterValueDict = IN[3]
corridorFloor = IN[4]
# Place your code below this line
result = {}
for i in corridorFloor:
    tmp = []
    for j in elementDict[i]:
        for k in range(len(parameterNameList)):
            if parameterNameList[k] == "Limit Offset":
                if parameterValueDict[i][k] == 0:
                    j.SetParameterByName(parameterNameList[k], BoxcorridorDict[i][0].GetParameterValueByName("Height"))
                else:
                    j.SetParameterByName(parameterNameList[k], parameterValueDict[i][k])
            elif parameterNameList[k] == "Interior Finish":
                paramValue = parameterValueDict[i][k].split(",,")
                wallTypeTmp = paramValue[0].split("..")
                wallType = ','.join(list(filter(lambda x: x != "N/A",wallTypeTmp)))
                baseTypeTmp = paramValue[1].split("..")
                baseType = ','.join(list(filter(lambda x: x != "N/A",baseTypeTmp)))
                floorTypeTmp = paramValue[2].split("..")
                floorType = ','.join(list(filter(lambda x: x != "N/A",floorTypeTmp)))
                ceilTypeTmp = paramValue[3].split("..")
                ceilType = ','.join(list(filter(lambda x: x != "N/A",ceilTypeTmp)))
                j.SetParameterByName("Wall Finish", wallType)
                j.SetParameterByName("Base Finish", baseType)
                j.SetParameterByName("Floor Finish", floorType)
                j.SetParameterByName("Ceiling Finish", ceilType)
                
                j.SetParameterByName(parameterNameList[k], parameterValueDict[i][k])

            else:
                j.SetParameterByName(parameterNameList[k], parameterValueDict[i][k])
        tmp.append(j)
    result[i] = tmp

# Assign your output to the OUT variable.
OUT = result
# ----------------------------------------
code_block_14 = CodeBlock(Room_CorWithParam=python_script_element)
# ---------- code_block_14.designscript (3 lines) ----------
{
"Room_CorWithParam": Room_CorWithParam
};
# ----------------------------------------
output_2 = Python(IN[0]=input.input, IN[1]=code_block_14)  # CPython3
# ---------- output_2.python (18 lines) ----------
# Load the Python Standard and DesignScript Libraries
import sys
import clr
clr.AddReference('ProtoGeometry')
from Autodesk.DesignScript.Geometry import *

# The inputs to this node will be stored as a list in the IN variables.
dataEnteringNode = IN

inputDic = IN[0]
addDics = IN[1]
# Place your code below this line

for i in addDics:
    inputDic[i] = addDics[i]

# Assign your output to the OUT variable.
OUT = inputDic
# ----------------------------------------

# group: 처리완료된 복도 제외한 레벨별 Room List 확보
input_2 = CodeBlock(input=output_2)
# ---------- input_2.designscript (9 lines) ----------
input;
input["Key_level"];
input["RoomElem"];
input["RoomSolid"];
input["RoomCentroid"];
input["BoxTotal"];
input["corridorFloor"];
input["Boxcorridor"];
input["Room_CorWithParam"];
# ----------------------------------------
valueAtKey_2 = DesignScript.Builtin.Dictionary.ValueAtKey(dictionary=input_2.out2, key=input_2.out1)
valueAtKey_3 = DesignScript.Builtin.Dictionary.ValueAtKey(dictionary=input_2.out8, key=input_2.out6)
python_script_corridor_remover = Python(IN[0]=valueAtKey_2, IN[1]=valueAtKey_3)  # CPython3
# ---------- python_script_corridor_remover.python (33 lines) ----------
# Load the Python Standard and DesignScript Libraries
import sys
import clr
clr.AddReference('ProtoGeometry')
from Autodesk.DesignScript.Geometry import *
from itertools import chain

# The inputs to this node will be stored as a list in the IN variables.
dataEnteringNode = IN

inputlist = IN[0]
targetlist = IN[1]
# Place your code below this line
targetFlat = list(chain.from_iterable(targetlist))

result = []
for i in inputlist: # 레벨 별
    tmp1 = []
    for j in i: # 레벨 내 방 별
        tmp2 = []
        for k in targetFlat:
            if j.Id != k.Id:
                tmp2.append(True)
            else:
                tmp2.append(False)
        if all(tmp2):
            tmp1.append(j)
        else:
            pass
    result.append(tmp1)

# Assign your output to the OUT variable.
OUT = result
# ----------------------------------------
byKeysValues_8 = DesignScript.Builtin.Dictionary.ByKeysValues(keys=input_2.out1, values=python_script_corridor_remover)
code_block_15 = CodeBlock(Room_noCorridor=byKeysValues_8)
# ---------- code_block_15.designscript (3 lines) ----------
{
"Room_noCorridor": Room_noCorridor
};
# ----------------------------------------
output_3 = Python(IN[0]=input_2.input, IN[1]=code_block_15)  # CPython3; same code as output_2

# group: Room-Box 매치 후, 매개변수 입력
code_block_16 = CodeBlock { "Name"; "Department"; "Interior Finish"; "Exterior Finish"; "Limit Offset"; }
join_3 = List.Join(list0=code_block_16.out0, list1=code_block_16.out1, list2=code_block_16.out2, list3=code_block_16.out3, list4=code_block_16.out4)
code_block_17 = CodeBlock { "Room Name"; "Department"; "Interior Finish"; "Exterior Finish"; "ceiling height"; }
join_4 = List.Join(list0=code_block_17.out0, list1=code_block_17.out1, list2=code_block_17.out2, list3=code_block_17.out3, list4=code_block_17.out4)
input_3 = CodeBlock(input=output_3)
# ---------- input_3.designscript (11 lines) ----------
input;
input["Key_level"];
input["RoomElem"];
input["RoomSolid"];
input["RoomCentroid"];
input["BoxTotal"];
input["corridorFloor"];
input["Boxcorridor"];
input["Room_CorWithParam"];
input["Room_noCorridor"];
input["Box_noCorridor"];
# ----------------------------------------
python_script_box_room_matching = Python(IN[0]=input_3.out1, IN[1]=input_3.out9, IN[2]=input_3.out10)  # CPython3
# ---------- python_script_box_room_matching.python (40 lines) ----------
# Load the Python Standard and DesignScript Libraries
import sys
import clr
clr.AddReference('ProtoGeometry')
from Autodesk.DesignScript.Geometry import *

# The inputs to this node will be stored as a list in the IN variables.
dataEnteringNode = IN

Key_level = IN[0]
Room_noCorridor = IN[1]
Box_noCorridor = IN[2]

# Place your code below this line
matchedRoomBox = {}
for i in Key_level:
    tmp1 = []
    for j in Room_noCorridor[i]:
        tmp2 = []
        for k in Box_noCorridor[i]:
            BDSolid_Room = BoundingBox.ByGeometry(j.Geometry()[0]).ToCuboid()
            center_Room = BDSolid_Room.Centroid()
            center_Room_tr = center_Room.Translate(0,0,-center_Room.Z)
            ###
            BDSolid_Box = BoundingBox.ByGeometry(k.Geometry()[0]).ToCuboid()
            center_Box = BDSolid_Box.Centroid()
            center_Box_tr = center_Box.Translate(0,0,-center_Box.Z)
            
            if center_Room_tr.IsAlmostEqualTo(center_Box_tr):
                tmp2.append(j)
                tmp2.append(k)
            else:
                pass
        tmp1.append(tmp2)
    matchedRoomBox[i] = tmp1


result = matchedRoomBox
# Assign your output to the OUT variable.
OUT = result
# ----------------------------------------
python_script_element_2 = Python(IN[0]=join_3, IN[1]=join_4, IN[2]=python_script_box_room_matching)  # "Python Script@Element.SetParameterByName"; CPython3
# ---------- python_script_element_2.python (51 lines) ----------
# Load the Python Standard and DesignScript Libraries
import sys
import clr
clr.AddReference('ProtoGeometry')
from Autodesk.DesignScript.Geometry import *

# The inputs to this node will be stored as a list in the IN variables.
dataEnteringNode = IN

roomParamNameList = IN[0]
boxParamNameList = IN[1]
elementDict = IN[2]

# Place your code below this line
result = {}
for i in elementDict: #level 별
    tmp = []
    for j in elementDict[i]:
        for k in range(len(roomParamNameList)):
            if roomParamNameList[k] == "Limit Offset":
                if j[1].GetParameterValueByName(boxParamNameList[k]) == 0:
                    paramValue = j[1].GetParameterValueByName("Height")
                    j[0].SetParameterByName(roomParamNameList[k], paramValue)
                else:
                    paramvalue = j[1].GetParameterValueByName(boxParamNameList[k])
                    j[0].SetParameterByName(roomParamNameList[k], paramvalue)
            elif roomParamNameList[k] == "Interior Finish":
                paramValue = j[1].GetParameterValueByName(boxParamNameList[k])
                paramValueSplit = paramValue.split(",,")
                wallTypeTmp = paramValueSplit[0].split("..")
                wallType = ','.join(list(filter(lambda x: x != "N/A",wallTypeTmp)))
                baseTypeTmp = paramValueSplit[1].split("..")
                baseType = ','.join(list(filter(lambda x: x != "N/A",baseTypeTmp)))
                floorTypeTmp = paramValueSplit[2].split("..")
                floorType = ','.join(list(filter(lambda x: x != "N/A",floorTypeTmp)))
                ceilTypeTmp = paramValueSplit[3].split("..")
                ceilType = ','.join(list(filter(lambda x: x != "N/A",ceilTypeTmp)))
                j[0].SetParameterByName("Wall Finish", wallType)
                j[0].SetParameterByName("Base Finish", baseType)
                j[0].SetParameterByName("Floor Finish", floorType)
                j[0].SetParameterByName("Ceiling Finish", ceilType)
                
                j[0].SetParameterByName(roomParamNameList[k], paramValue)
            else:
                paramValue = j[1].GetParameterValueByName(boxParamNameList[k])
                j[0].SetParameterByName(roomParamNameList[k], paramValue)
        tmp.append(j[0])
    result[i] = tmp

# Assign your output to the OUT variable.
OUT = result
# ----------------------------------------
