# Dynamo graph 2-3_Room with Param Generating(221202).dyn (Dynamo 2.13.1.3887)

# group: 모든 룸 불러오기 + Level 별 정렬
categories = Categories("OST_Rooms")
all_elements_of_category = ElementsOfCategory(Category=categories)
code_block = CodeBlock { "Level"; }
getParameterValueByName = Element.GetParameterValueByName(element=all_elements_of_category, parameterName=code_block)
uniqueItems = List.UniqueItems(list=getParameterValueByName)
allIndicesOf = List.AllIndicesOf(list=getParameterValueByName, item=uniqueItems)
getItemAtIndex = List.GetItemAtIndex(list=all_elements_of_category, index=allIndicesOf)
byKeysValues = DesignScript.Builtin.Dictionary.ByKeysValues(keys=uniqueItems, values=getItemAtIndex)

# group: 모든 Generic Box 불러오기
code_block_2 = CodeBlock(levelFromRoom=uniqueItems) { levelFromRoom; }
categories_2 = Categories("OST_GenericModel")
all_elements_of_category_2 = ElementsOfCategory(Category=categories_2)
name = Element.Name(element=all_elements_of_category_2)
code_block_3 = CodeBlock { "Space Planning Box"; }
contains = String.Contains(string=name, searchFor=code_block_3)
filterByBoolMask = List.FilterByBoolMask(list=all_elements_of_category_2, mask=contains)
code_block_4 = CodeBlock { "Level"; }
getParameterValueByName_2 = Element.GetParameterValueByName(element=filterByBoolMask.in, parameterName=code_block_4)
name_2 = Level.Name(level=getParameterValueByName_2)
contains_2 = String.Contains(string=name_2, searchFor=code_block_2@L1)
code_block_5 = CodeBlock { true; }
allIndicesOf_2 = List.AllIndicesOf(list=contains_2@L2, item=code_block_5)
getItemAtIndex_2 = List.GetItemAtIndex(list=filterByBoolMask.in, index=allIndicesOf_2)
byKeysValues_2 = DesignScript.Builtin.Dictionary.ByKeysValues(keys=code_block_2, values=getItemAtIndex_2)

# group: Box 중 "Corridor Box" 분리
code_block_6 = CodeBlock(input=byKeysValues_2) { input; }
components = DesignScript.Builtin.Dictionary.Components(dictionary=code_block_6)
code_block_7 = CodeBlock(i=components.values) { i; }
code_block_8 = CodeBlock { "Room Name"; }
getParameterValueByName_3 = Element.GetParameterValueByName(element=code_block_7, parameterName=code_block_8)
string_from_object = FromObject(object=getParameterValueByName_3)
code_block_9 = CodeBlock { "Corridor"; }
contains_3 = String.Contains(string=string_from_object, searchFor=code_block_9)
filterByBoolMask_2 = List.FilterByBoolMask(list=code_block_7, mask=contains_3)
byKeysValues_3 = DesignScript.Builtin.Dictionary.ByKeysValues(keys=components.keys, values=filterByBoolMask_2.in)

# group: Corridor 존재 층
anyTrue = List.AnyTrue(list=contains_3@L2)
code_block_10 = CodeBlock { true; }
allIndicesOf_3 = List.AllIndicesOf(list=anyTrue, item=code_block_10)
getItemAtIndex_3 = List.GetItemAtIndex(list=components.keys, index=allIndicesOf_3)

# group: Corridor 제외 Box 레벨별 딕셔너리 생성
byKeysValues_4 = DesignScript.Builtin.Dictionary.ByKeysValues(keys=components.keys, values=filterByBoolMask_2.out)
box_noCorridor = CodeBlock(i=byKeysValues_4) { i; }

# group: 룸 형상화 및 중점 추출
code_block_11 = CodeBlock(input=byKeysValues) { input; }
components_2 = DesignScript.Builtin.Dictionary.Components(dictionary=code_block_11)
geometry = Element.Geometry(element=components_2.values)
flatten = List.Flatten(list=geometry@L3)
byKeysValues_5 = DesignScript.Builtin.Dictionary.ByKeysValues(keys=components_2.keys, values=flatten)
centroid = Solid.Centroid(solid=flatten)
byKeysValues_6 = DesignScript.Builtin.Dictionary.ByKeysValues(keys=components_2.keys, values=centroid)
output = CodeBlock(Key_level=components_2.keys, RoomElem=code_block_11, RoomSolid=byKeysValues_5, RoomCentroid=byKeysValues_6, BoxTotal=byKeysValues_2, corridorFloor=getItemAtIndex_3, Boxcorridor=byKeysValues_3, Box_noCorridor=box_noCorridor)
# ---------- output.designscript (10 lines) ----------
box = {
"Key_level": Key_level,
"RoomElem": RoomElem,
"RoomSolid": RoomSolid,
"RoomCentroid": RoomCentroid,
"BoxTotal": BoxTotal,
"corridorFloor": corridorFloor,
"Boxcorridor": Boxcorridor,
"Box_noCorridor": Box_noCorridor
};
# ----------------------------------------

# group: Corridor에 해당하는 Room 객체 찾고 매개변수 입력
input = CodeBlock(input=output)
# ---------- input.designscript (8 lines) ----------
input;
input["Key_level"];
input["RoomElem"];
input["RoomSolid"];
input["RoomCentroid"];
input["BoxTotal"];
input["corridorFloor"];
input["Boxcorridor"];
# ----------------------------------------
code_block_12 = CodeBlock { "Name"; "Department"; "Interior Finish"; "Exterior Finish"; "Limit Offset"; }
join = List.Join(list0=code_block_12.out0, list1=code_block_12.out1, list2=code_block_12.out2, list3=code_block_12.out3, list4=code_block_12.out4)
python_script_find_corridor = Python(IN[1]=input.out1, IN[2]=input.out2, IN[3]=input.out3, IN[4]=input.out4, IN[5]=input.out5, IN[6]=input.out6)  # CPython3; unwired: IN[0]
# ---------- python_script_find_corridor.python (36 lines) ----------
# Load the Python Standard and DesignScript Libraries
import sys
import clr
clr.AddReference('ProtoGeometry')
from Autodesk.DesignScript.Geometry import *

# The inputs to this node will be stored as a list in the IN variables.
dataEnteringNode = IN

Key_level = IN[1]
RoomElem = IN[2]
RoomSolid = IN[3]
RoomCentroid = IN[4]
Box_Total = IN[5]
corridorFloor = IN[6]
# Place your code below this line
corridorIndex = {}
for i in corridorFloor:
    tmp1 = []
    for j in RoomCentroid[i]:
        tmp2 = []
        for k in Box_Total[i]:
            if len(Box_Total[i]) > 0:
                bln = j.DoesIntersect(k.Geometry()[0])
                if bln == True:
                    tmp2.append(bln)
            else:
                pass
        if len(tmp2) == 1:
            idx = RoomCentroid[i].index(j)
            tmp1.append(RoomElem[i][idx])
    corridorIndex[i] = tmp1


# Assign your output to the OUT variable.
OUT = corridorIndex
# ----------------------------------------
valueAtKey = DesignScript.Builtin.Dictionary.ValueAtKey(dictionary=input.out7, key=input.out6)
code_block_13 = CodeBlock { "Room Name"; "Department"; "Interior Finish"; "Exterior Finish"; "ceiling height"; }
join_2 = List.Join(list0=code_block_13.out0, list1=code_block_13.out1, list2=code_block_13.out2, list3=code_block_13.out3, list4=code_block_13.out4)
getParameterValueByName_4 = Element.GetParameterValueByName(element=valueAtKey, parameterName=join_2, lacing=CrossProduct)
flatten_2 = List.Flatten(list=getParameterValueByName_4@L3)
byKeysValues_7 = DesignScript.Builtin.Dictionary.ByKeysValues(keys=input.out6, values=flatten_2)
python_script_element = Python(IN[0]=input.out7, IN[1]=join, IN[2]=python_script_find_corridor, IN[3]=byKeysValues_7, IN[4]=input.out6)  # "Python Script@Element.SetParameterByName"; CPython3; frozen
# ---------- python_script_element.python (49 lines) ----------
# Load the Python Standard and DesignScript Libraries
import sys
import clr
clr.AddReference('ProtoGeometry')
from Autodesk.DesignScript.Geometry import *

# The inputs to this node will be stored as a list in the IN variables.
dataEnteringNode = IN

BoxcorridorDict = IN[0]
parameterNameList = IN[1]
elementDict = IN[2]
parameterValueDict = IN[3]
corridorFloor = IN[4]
# Place your code below this line
result = {}
for i in corridorFloor:
    tmp = []
    for j in elementDict[i]:
        for k in range(len(parameterNameList)):
            if parameterNameList[k] == "Limit Offset":
                if parameterValueDict[i][k] == 0:
                    j.SetParameterByName(parameterNameList[k], BoxcorridorDict[i][0].GetParameterValueByName("Height"))
                else:
                    j.SetParameterByName(parameterNameList[k], parameterValueDict[i][k])
            elif parameterNameList[k] == "Interior Finish":
                paramValue = parameterValueDict[i][k].split(",,")
                wallTypeTmp = paramValue[0].split("..")
                wallType = ','.join(list(filter(lambda x: x != "N/A",wallTypeTmp)))
                baseTypeTmp = paramValue[1].split("..")
                baseType = ','.join(list(filter(lambda x: x != "N/A",baseTypeTmp)))
                floorTypeTmp = paramValue[2].split("..")
                floorType = ','.join(list(filter(lambda x: x != "N/A",floorTypeTmp)))
                ceilTypeTmp = paramValue[3].split("..")
                ceilType = ','.join(list(filter(lambda x: x != "N/A",ceilTypeTmp)))
                j.SetParameterByName("Wall Finish", wallType)
                j.SetParameterByName("Base Finish", baseType)
                j.SetParameterByName("Floor Finish", floorType)
                j.SetParameterByName("Ceiling Finish", ceilType)
                
                j.SetParameterByName(parameterNameList[k], parameterValueDict[i][k])

            else:
                j.SetParameterByName(parameterNameList[k], parameterValueDict[i][k])
        tmp.append(j)
    result[i] = tmp

# Assign your output to the OUT variable.
OUT = result
# ----------------------------------------
code_block_14 = CodeBlock(Room_CorWithParam=python_script_element)
# ---------- code_block_14.designscript (3 lines) ----------
{
"Room_CorWithParam": Room_CorWithParam
};
# ----------------------------------------
output_2 = Python(IN[0]=input.input, IN[1]=code_block_14)  # CPython3
# ---------- output_2.python (18 lines) ----------
# Load the Python Standard and DesignScript Libraries
import sys
import clr
clr.AddReference('ProtoGeometry')
from Autodesk.DesignScript.Geometry import *

# The inputs to this node will be stored as a list in the IN variables.
dataEnteringNode = IN

inputDic = IN[0]
addDics = IN[1]
# Place your code below this line

for i in addDics:
    inputDic[i] = addDics[i]

# Assign your output to the OUT variable.
OUT = inputDic
# ----------------------------------------

# group: 처리완료된 복도 제외한 레벨별 Room List 확보
input_2 = CodeBlock(input=output_2)
# ---------- input_2.designscript (9 lines) ----------
input;
input["Key_level"];
input["RoomElem"];
input["RoomSolid"];
input["RoomCentroid"];
input["BoxTotal"];
input["corridorFloor"];
input["Boxcorridor"];
input["Room_CorWithParam"];
# ----------------------------------------
valueAtKey_2 = DesignScript.Builtin.Dictionary.ValueAtKey(dictionary=input_2.out2, key=input_2.out1)
valueAtKey_3 = DesignScript.Builtin.Dictionary.ValueAtKey(dictionary=input_2.out8, key=input_2.out6)
python_script_corridor_remover = Python(IN[0]=valueAtKey_2, IN[1]=valueAtKey_3)  # CPython3
# ---------- python_script_corridor_remover.python (33 lines) ----------
# Load the Python Standard and DesignScript Libraries
import sys
import clr
clr.AddReference('ProtoGeometry')
from Autodesk.DesignScript.Geometry import *
from itertools import chain

# The inputs to this node will be stored as a list in the IN variables.
dataEnteringNode = IN

inputlist = IN[0]
targetlist = IN[1]
# Place your code below this line
targetFlat = list(chain.from_iterable(targetlist))

result = []
for i in inputlist: # 레벨 별
    tmp1 = []
    for j in i: # 레벨 내 방 별
        tmp2 = []
        for k in targetFlat:
            if j.Id != k.Id:
                tmp2.append(True)
            else:
                tmp2.append(False)
        if all(tmp2):
            tmp1.append(j)
        else:
            pass
    result.append(tmp1)

# Assign your output to the OUT variable.
OUT = result
# ----------------------------------------
byKeysValues_8 = DesignScript.Builtin.Dictionary.ByKeysValues(keys=input_2.out1, values=python_script_corridor_remover)
code_block_15 = CodeBlock(Room_noCorridor=byKeysValues_8)
# ---------- code_block_15.designscript (3 lines) ----------
{
"Room_noCorridor": Room_noCorridor
};
# ----------------------------------------
output_3 = Python(IN[0]=input_2.input, IN[1]=code_block_15)  # CPython3; same code as output_2

# group: Room-Box 매치 후, 매개변수 입력
code_block_16 = CodeBlock { "Name"; "Department"; "Interior Finish"; "Exterior Finish"; "Limit Offset"; }
join_3 = List.Join(list0=code_block_16.out0, list1=code_block_16.out1, list2=code_block_16.out2, list3=code_block_16.out3, list4=code_block_16.out4)
code_block_17 = CodeBlock { "Room Name"; "Department"; "Interior Finish"; "Exterior Finish"; "ceiling height"; }
join_4 = List.Join(list0=code_block_17.out0, list1=code_block_17.out1, list2=code_block_17.out2, list3=code_block_17.out3, list4=code_block_17.out4)
input_3 = CodeBlock(input=output_3)
# ---------- input_3.designscript (11 lines) ----------
input;
input["Key_level"];
input["RoomElem"];
input["RoomSolid"];
input["RoomCentroid"];
input["BoxTotal"];
input["corridorFloor"];
input["Boxcorridor"];
input["Room_CorWithParam"];
input["Room_noCorridor"];
input["Box_noCorridor"];
# ----------------------------------------
python_script_box_room_matching = Python(IN[0]=input_3.out1, IN[1]=input_3.out9, IN[2]=input_3.out10)  # CPython3; frozen
# ---------- python_script_box_room_matching.python (40 lines) ----------
# Load the Python Standard and DesignScript Libraries
import sys
import clr
clr.AddReference('ProtoGeometry')
from Autodesk.DesignScript.Geometry import *

# The inputs to this node will be stored as a list in the IN variables.
dataEnteringNode = IN

Key_level = IN[0]
Room_noCorridor = IN[1]
Box_noCorridor = IN[2]

# Place your code below this line
matchedRoomBox = {}
for i in Key_level:
    tmp1 = []
    for j in Room_noCorridor[i]:
        tmp2 = []
        for k in Box_noCorridor[i]:
            BDSolid_Room = BoundingBox.ByGeometry(j.Geometry()[0]).ToCuboid()
            center_Room = BDSolid_Room.Centroid()
            center_Room_tr = center_Room.Translate(0,0,-center_Room.Z)
            ###
            BDSolid_Box = BoundingBox.ByGeometry(k.Geometry()[0]).ToCuboid()
            center_Box = BDSolid_Box.Centroid()
            center_Box_tr = center_Box.Translate(0,0,-center_Box.Z)
            
            if center_Room_tr.IsAlmostEqualTo(center_Box_tr):
                tmp2.append(j)
                tmp2.append(k)
            else:
                pass
        tmp1.append(tmp2)
    matchedRoomBox[i] = tmp1


result = matchedRoomBox
# Assign your output to the OUT variable.
OUT = result
# ----------------------------------------
python_script_element_2 = Python(IN[0]=join_3, IN[1]=join_4, IN[2]=python_script_box_room_matching)  # "Python Script@Element.SetParameterByName"; CPython3; frozen
# ---------- python_script_element_2.python (51 lines) ----------
# Load the Python Standard and DesignScript Libraries
import sys
import clr
clr.AddReference('ProtoGeometry')
from Autodesk.DesignScript.Geometry import *

# The inputs to this node will be stored as a list in the IN variables.
dataEnteringNode = IN

roomParamNameList = IN[0]
boxParamNameList = IN[1]
elementDict = IN[2]

# Place your code below this line
result = {}
for i in elementDict: #level 별
    tmp = []
    for j in elementDict[i]:
        for k in range(len(roomParamNameList)):
            if roomParamNameList[k] == "Limit Offset":
                if j[1].GetParameterValueByName(boxParamNameList[k]) == 0:
                    paramValue = j[1].GetParameterValueByName("Height")
                    j[0].SetParameterByName(roomParamNameList[k], paramValue)
                else:
                    paramvalue = j[1].GetParameterValueByName(boxParamNameList[k])
                    j[0].SetParameterByName(roomParamNameList[k], paramvalue)
            elif roomParamNameList[k] == "Interior Finish":
                paramValue = j[1].GetParameterValueByName(boxParamNameList[k])
                paramValueSplit = paramValue.split(",,")
                wallTypeTmp = paramValueSplit[0].split("..")
                wallType = ','.join(list(filter(lambda x: x != "N/A",wallTypeTmp)))
                baseTypeTmp = paramValueSplit[1].split("..")
                baseType = ','.join(list(filter(lambda x: x != "N/A",baseTypeTmp)))
                floorTypeTmp = paramValueSplit[2].split("..")
                floorType = ','.join(list(filter(lambda x: x != "N/A",floorTypeTmp)))
                ceilTypeTmp = paramValueSplit[3].split("..")
                ceilType = ','.join(list(filter(lambda x: x != "N/A",ceilTypeTmp)))
                j[0].SetParameterByName("Wall Finish", wallType)
                j[0].SetParameterByName("Base Finish", baseType)
                j[0].SetParameterByName("Floor Finish", floorType)
                j[0].SetParameterByName("Ceiling Finish", ceilType)
                
                j[0].SetParameterByName(roomParamNameList[k], paramValue)
            else:
                paramValue = j[1].GetParameterValueByName(boxParamNameList[k])
                j[0].SetParameterByName(roomParamNameList[k], paramValue)
        tmp.append(j[0])
    result[i] = tmp

# Assign your output to the OUT variable.
OUT = result
# ----------------------------------------

code_block_18 = CodeBlock { {}; }
code_block_19 = CodeBlock { "box obj"; }
categories_3 = Categories("OST_GenericModel")
all_elements_of_category_3 = ElementsOfCategory(Category=categories_3)
name_3 = Element.Name(element=all_elements_of_category_3)
code_block_20 = CodeBlock { "Space Planning Box"; }
contains_4 = String.Contains(string=name_3, searchFor=code_block_20)
filterByBoolMask_3 = List.FilterByBoolMask(list=all_elements_of_category_3, mask=contains_4)

# group: box 선별
# set Dictionary
mkNewDicts = Python(IN[0]=code_block_18, IN[1]=code_block_19, IN[2]=filterByBoolMask_3.in)  # CPython3
# ---------- mkNewDicts.python (32 lines) ----------
# Load the Python Standard and DesignScript Libraries
import sys
import clr
clr.AddReference('ProtoGeometry')
from Autodesk.DesignScript.Geometry import *

# The inputs to this node will be stored as a list in the IN variables.
dataEnteringNode = IN

preDicts = IN[0]
newKey = IN[1]
newValues = IN[2]

# Place your code below this line

def mkNewDicts(preDicts, newKey, newValues):
    if preDicts == {}:
        preDicts = []
        list(map(lambda x: preDicts.append({}), newValues))
    else:
        pass

    dict_valuePairs = zip(preDicts, newValues)
    
    def mkNewDict(_dict, _key, _value):
        _dict[_key] = _value
        return _dict
    
    result = map(lambda x: mkNewDict(x[0], newKey, x[1]), dict_valuePairs)
    return result
# Assign your output to the OUT variable.
OUT = mkNewDicts(preDicts, newKey, newValues)
# ----------------------------------------

code_block_21 = CodeBlock(d=mkNewDicts) { d; }
code_block_22 = CodeBlock { "box obj"; }
valueAtKey_4 = DesignScript.Builtin.Dictionary.ValueAtKey(dictionary=code_block_21, key=code_block_22)
code_block_23 = CodeBlock { "Level"; }
getParameterValueByName_5 = Element.GetParameterValueByName(element=valueAtKey_4, parameterName=code_block_23)
string_from_object_2 = FromObject(object=getParameterValueByName_5)
code_block_24 = CodeBlock()
# ---------- code_block_24.designscript (10 lines) ----------
// 룸세퍼레이션 할 때, 코리더 박스 테두리는 외곽만 반영하도록 처리하고 시작해야 할듯
// (2-1 파일에 반영완료)
// 그래야 한층에 2개 이상의 마감 사양이 다른 코리더 배치 가능해짐

// corridor 들 끼리 매칭

// 층별로 corridor box - corridor room 모아두기
// 박스하나에 룸 하나 - 복도구간이 하나, 당연히 복도 마감사양도 하나
// 박스하나에 룸 둘 - 상호 분리된 복도 2개 이상, 마감 사양은 동일
// 박스 둘에 룸 하나?xx, 박스 둘에 룸 둘 - 상호 분리된 복도 2개 이상, 마감 사양도 2개
# ----------------------------------------
roomParamList = CodeBlock()
# ---------- roomParamList.designscript (7 lines) ----------
[
"Name",
"Department",
"Interior Finish",
"Exterior Finish",
"Limit Offset"
];
# ----------------------------------------
boxParamList = CodeBlock()
# ---------- boxParamList.designscript (7 lines) ----------
[
"Room Name",
"Department",
"Interior Finish",
"Exterior Finish",
"ceiling height"
];
# ----------------------------------------
code_block_25 = CodeBlock { {}; }
code_block_26 = CodeBlock { "room obj"; }
categories_4 = Categories("OST_Rooms")
all_elements_of_category_4 = ElementsOfCategory(Category=categories_4)

# group: 
# set Dictionary
mkNewDicts_2 = Python(IN[0]=code_block_25, IN[1]=code_block_26, IN[2]=all_elements_of_category_4)  # CPython3; same code as mkNewDicts

code_block_27 = CodeBlock(d=mkNewDicts_2) { d; }
code_block_28 = CodeBlock { "room lv"; }
code_block_29 = CodeBlock { "room obj"; }
valueAtKey_5 = DesignScript.Builtin.Dictionary.ValueAtKey(dictionary=code_block_27, key=code_block_29)
code_block_30 = CodeBlock { "Level"; }
getParameterValueByName_6 = Element.GetParameterValueByName(element=valueAtKey_5, parameterName=code_block_30)

# group: 
# set Dictionary
mkNewDicts_3 = Python(IN[0]=code_block_27, IN[1]=code_block_28, IN[2]=getParameterValueByName_6)  # CPython3; same code as mkNewDicts

code_block_31 = CodeBlock(d=mkNewDicts_3) { d; }
code_block_32 = CodeBlock { "room geo"; }
code_block_33 = CodeBlock { "room obj"; }
valueAtKey_6 = DesignScript.Builtin.Dictionary.ValueAtKey(dictionary=code_block_31, key=code_block_33)
geometry_2 = Element.Geometry(element=valueAtKey_6)
flatten_3 = List.Flatten(list=geometry_2)

# group: 
# set Dictionary
mkNewDicts_4 = Python(IN[0]=code_block_31, IN[1]=code_block_32, IN[2]=flatten_3)  # CPython3; same code as mkNewDicts

code_block_34 = CodeBlock(d=mkNewDicts_4) { d; }
code_block_35 = CodeBlock { "room btmSrf"; }
code_block_36 = CodeBlock { "room geo"; }
valueAtKey_7 = DesignScript.Builtin.Dictionary.ValueAtKey(dictionary=code_block_34, key=code_block_36)
explode = Geometry.Explode(geometry=valueAtKey_7)
normalAtParameter = Surface.NormalAtParameter(surface=explode)
code_block_37 = CodeBlock { -1; }
byCoordinates = Vector.ByCoordinates(z=code_block_37)
isAlmostEqualTo = Vector.IsAlmostEqualTo(vector=normalAtParameter, otherVector=byCoordinates)
filterByBoolMask_4 = List.FilterByBoolMask(list=explode, mask=isAlmostEqualTo)
flatten_4 = List.Flatten(list=filterByBoolMask_4.in)

# group: 
# set Dictionary
mkNewDicts_5 = Python(IN[0]=code_block_34, IN[1]=code_block_35, IN[2]=flatten_4)  # CPython3; same code as mkNewDicts

code_block_38 = CodeBlock { "room btmCenPoint"; }
code_block_39 = CodeBlock(d=mkNewDicts_5) { d; }
code_block_40 = CodeBlock { "room btmSrf"; }
valueAtKey_8 = DesignScript.Builtin.Dictionary.ValueAtKey(dictionary=code_block_39, key=code_block_40)
code_block_41 = CodeBlock { 0.5; }
pointAtParameter = Surface.PointAtParameter(surface=valueAtKey_8, u=code_block_41, v=code_block_41)

# group: 
# set Dictionary
mkNewDicts_6 = Python(IN[0]=mkNewDicts_5, IN[1]=code_block_38, IN[2]=pointAtParameter)  # CPython3; same code as mkNewDicts

code_block_42 = CodeBlock { "room offsetBtmSrf"; }
code_block_43 = CodeBlock(d=mkNewDicts_6) { d; }
code_block_44 = CodeBlock { "room btmSrf"; }
valueAtKey_9 = DesignScript.Builtin.Dictionary.ValueAtKey(dictionary=code_block_43, key=code_block_44)
outerPerimeterCurves = AnalyticalAutomation.Geometry.Surface.OuterPerimeterCurves(surface=valueAtKey_9)
flatten_5 = List.Flatten(list=outerPerimeterCurves)
code_block_45 = CodeBlock { -100; }
offset = Curve.Offset(curve=flatten_5, distance=code_block_45)
byPatch = Surface.ByPatch(closedCurve=offset)

# group: 
# set Dictionary
mkNewDicts_7 = Python(IN[0]=mkNewDicts_6, IN[1]=code_block_42, IN[2]=byPatch)  # CPython3; same code as mkNewDicts

code_block_46 = CodeBlock { "room offsetGeo"; }
code_block_47 = CodeBlock { 100; }
boolean = BoolSelector(false)
thicken = Surface.Thicken(surface=byPatch, thickness=code_block_47, both_sides=boolean)

# group: 
# set Dictionary
mkNewDicts_8 = Python(IN[0]=mkNewDicts_7, IN[1]=code_block_46, IN[2]=thicken)  # CPython3; same code as mkNewDicts

room_dict = CodeBlock(d=mkNewDicts_8) { d; }
code_block_48 = CodeBlock { "box_roomName"; }
code_block_49 = CodeBlock { "Room Name"; }
getParameterValueByName_7 = Element.GetParameterValueByName(element=valueAtKey_4, parameterName=code_block_49)

# group: 
# set Dictionary
mkNewDicts_9 = Python(IN[0]=code_block_21, IN[1]=code_block_48, IN[2]=getParameterValueByName_7)  # CPython3; same code as mkNewDicts

code_block_50 = CodeBlock { "box lv"; }
name_4 = Level.Name(level=getParameterValueByName_5)

# group: 
# set Dictionary
mkNewDicts_10 = Python(IN[0]=mkNewDicts_9, IN[1]=code_block_50, IN[2]=name_4)  # CPython3; same code as mkNewDicts

code_block_51 = CodeBlock(d=mkNewDicts_10) { d; }
code_block_52 = CodeBlock { "box geo"; }
code_block_53 = CodeBlock { "box obj"; }
valueAtKey_10 = DesignScript.Builtin.Dictionary.ValueAtKey(dictionary=code_block_51, key=code_block_53)
geometry_3 = Element.Geometry(element=valueAtKey_10)
flatten_6 = List.Flatten(list=geometry_3)

# group: 
# set Dictionary
mkNewDicts_11 = Python(IN[0]=code_block_51, IN[1]=code_block_52, IN[2]=flatten_6)  # CPython3; same code as mkNewDicts

code_block_54 = CodeBlock { "box btmSrf"; }
code_block_55 = CodeBlock(d=mkNewDicts_11) { d; }
findBoxesBtmSrfCenter = Python(IN[0]=code_block_55)  # CPython3
# ---------- findBoxesBtmSrfCenter.python (25 lines) ----------
# Load the Python Standard and DesignScript Libraries
import sys
import clr
clr.AddReference('ProtoGeometry')
from Autodesk.DesignScript.Geometry import *

# The inputs to this node will be stored as a list in the IN variables.
dataEnteringNode = IN
boxDicts = IN[0]

# Place your code below this line

def findBoxesBtmSrfCenter(boxDicts):
    btmSrfs = map(findBoxBtmSrf, boxDicts)
    res = map(lambda x: x.PointAtParameter(0.5,0.5), btmSrfs)
    return res

def findBoxBtmSrf(boxDict):
    reverseZvec = Vector.ByCoordinates(0,0,-1)
    srfs = Geometry.Explode(boxDict["box geo"])
    btmSrf = filter(lambda x: x.NormalAtParameter(0.5,0.5).IsAlmostEqualTo(reverseZvec), srfs)
    return list(btmSrf)[0]

# Assign your output to the OUT variable.
OUT = (map(findBoxBtmSrf, boxDicts), findBoxesBtmSrfCenter(boxDicts))
# ----------------------------------------
code_block_56 = CodeBlock(i=findBoxesBtmSrfCenter)
# ---------- code_block_56.designscript (4 lines) ----------
i[0];
 //btm srfs;
i[1];
 //btm cenPoint;
# ----------------------------------------

# group: 
# set Dictionary
mkNewDicts_12 = Python(IN[0]=mkNewDicts_11, IN[1]=code_block_54, IN[2]=code_block_56.out0)  # CPython3; same code as mkNewDicts

code_block_57 = CodeBlock { "box btmCenPoint"; }

# group: 
# set Dictionary
mkNewDicts_13 = Python(IN[0]=mkNewDicts_12, IN[1]=code_block_57, IN[2]=code_block_56.out1)  # CPython3; same code as mkNewDicts

box_dict = CodeBlock(d=mkNewDicts_13) { d; }
separate_room_corridor_others = Python(IN[0]=room_dict, IN[1]=box_dict)  # CPython3
# ---------- separate_room_corridor_others.python (71 lines) ----------
# Load the Python Standard and DesignScript Libraries
import sys
import clr
clr.AddReference('ProtoGeometry')
from Autodesk.DesignScript.Geometry import *
#from itertools import groupby
#import operator

# The inputs to this node will be stored as a list in the IN variables.
dataEnteringNode = IN
roomDicts = IN[0]
boxDicts = IN[1]

# Place your code below this line

def groupBy(keys, values):
    res = {}
    pair = list(zip(keys, values))
    uniqueKeys = set(keys)
    for uniKey in uniqueKeys:
        tmp = []
        for k,v in pair:
            if k in uniKey:
                tmp.append(v)    
        res[uniKey] = tmp
    return res



def countIntsctTimesEach(boxDicts, roomDict):
    roomGeo = roomDict["room offsetGeo"]
    boxDictsSameFloor = filter(lambda x: x["box lv"] == roomDict["room lv"], boxDicts)
    boxGeos = map(lambda x: x["box geo"], boxDictsSameFloor)
    chkResult = filter(lambda x: roomGeo.DoesIntersect(x), boxGeos)
    
    return len(list(chkResult))



def findNoCorridorLv(boxDicts):
    res = []
    keys = list(map(lambda x: x["box lv"], boxDicts))
    boxesByFloor = groupBy(keys, boxDicts)
    for k,v in boxesByFloor.items():
        tmp = []
        for j in v:
            if j["box_roomName"] == "Corridor":
                tmp.append(False)
            else: tmp.append(True)
        if all(tmp):
            res.append(k)
            
    return res
    
def separateCorridor(boxDicts, roomDicts):
    (corridors, noCorridors) = [], []
    noCorridorLv = findNoCorridorLv(boxDicts)
    for i in roomDicts:
        if i["room lv"] in noCorridorLv:
            noCorridors.append(i)
        else:
            if countIntsctTimesEach(boxDicts, i) == 1:
                corridors.append(i)
            else: noCorridors.append(i)
    return {"corridorRoom": corridors, "noCorridorRoom": noCorridors}

#res = filter(lambda x: countIntsctTimesEach(boxDicts, x) == 1, roomDicts)


# Assign your output to the OUT variable.
OUT = separateCorridor(boxDicts, roomDicts)
# ----------------------------------------
code_block_58 = CodeBlock(i=separate_room_corridor_others) { i["corridorRoom"]; }
seperate_box_corridor_others = Python(IN[0]=box_dict)  # CPython3
# ---------- seperate_box_corridor_others.python (21 lines) ----------
# Load the Python Standard and DesignScript Libraries
import sys
import clr
clr.AddReference('ProtoGeometry')
from Autodesk.DesignScript.Geometry import *

# The inputs to this node will be stored as a list in the IN variables.
dataEnteringNode = IN
boxDicts = IN[0]

# Place your code below this line

def separateCorridorBox(boxDicts):
    a = filter(lambda x: x["box_roomName"] == "Corridor", boxDicts)
    b = filter(lambda x: x["box_roomName"] != "Corridor", boxDicts)
    
    return {"corridorBox": a, "noCorridorBox": b}


# Assign your output to the OUT variable.
OUT = separateCorridorBox(boxDicts)
# ----------------------------------------
code_block_59 = CodeBlock(i=seperate_box_corridor_others) { i["corridorBox"]; }
match_roomAndbox_corridor = Python(IN[0]=code_block_58, IN[1]=code_block_59)  # CPython3
# ---------- match_roomAndbox_corridor.python (32 lines) ----------
# Load the Python Standard and DesignScript Libraries
import sys
import clr
clr.AddReference('ProtoGeometry')
from Autodesk.DesignScript.Geometry import *

# The inputs to this node will be stored as a list in the IN variables.
dataEnteringNode = IN
roomDicts = IN[0]
boxDicts = IN[1]

# Place your code below this line
def isInclude(roomDict, boxDict):
    roomOffsetBtmSrf = roomDict["room offsetBtmSrf"]
    boxBtmSrf = boxDict["box btmSrf"]
    try:
        diff = roomOffsetBtmSrf.Difference([boxBtmSrf])
    except:
        return True
    else:
        return False


def match_roomAndbox_corridor(roomDict, boxDicts):
    res = filter(lambda x: isInclude(roomDict, x), boxDicts)
    roomDict["matchedBox"] = res
    return roomDict

            

# Assign your output to the OUT variable.
OUT = map(lambda x: match_roomAndbox_corridor(x, boxDicts), roomDicts)
# ----------------------------------------
code_block_60 = CodeBlock(i=separate_room_corridor_others) { i["noCorridorRoom"]; }
code_block_61 = CodeBlock(i=seperate_box_corridor_others) { i["noCorridorBox"]; }
match_roomAndbox = Python(IN[0]=code_block_60, IN[1]=code_block_61)  # CPython3
# ---------- match_roomAndbox.python (26 lines) ----------
# Load the Python Standard and DesignScript Libraries
import sys
import clr
clr.AddReference('ProtoGeometry')
from Autodesk.DesignScript.Geometry import *

# The inputs to this node will be stored as a list in the IN variables.
dataEnteringNode = IN
roomDicts = IN[0]
boxDicts = IN[1]

# Place your code below this line
def isCenPointEqual(roomDict, boxDict):
    roomCenPt = roomDict["room btmCenPoint"]
    boxCenPt = boxDict["box btmCenPoint"]
    return roomCenPt.IsAlmostEqualTo(boxCenPt)


def match_roomAndbox(roomDict, boxDicts):
    res = filter(lambda x: isCenPointEqual(roomDict, x), boxDicts)
    roomDict["matchedBox"] = res
    return roomDict
            

# Assign your output to the OUT variable.
OUT = map(lambda x: match_roomAndbox(x, boxDicts), roomDicts)
# ----------------------------------------
join_5 = List.Join(list0=match_roomAndbox_corridor, list1=match_roomAndbox)
setRoomParameterValues = Python(IN[0]=roomParamList, IN[1]=boxParamList, IN[2]=join_5)  # CPython3
# ---------- setRoomParameterValues.python (62 lines) ----------
# Load the Python Standard and DesignScript Libraries
import sys
import clr
clr.AddReference('ProtoGeometry')
from Autodesk.DesignScript.Geometry import *

# The inputs to this node will be stored as a list in the IN variables.
dataEnteringNode = IN
roomParamList = IN[0]
boxParamList = IN[1]
roomDicts = IN[2]

# Place your code below this line
def setRoomParameterValues(roomParamList, boxParamList, roomDict):
    roomObj = roomDict["room obj"]
    boxDict = roomDict["matchedBox"][0]
    boxObj = boxDict["box obj"]
    paramPair = zip(roomParamList, boxParamList)
    

    for rP,bP in paramPair:
        paramValue = boxObj.GetParameterValueByName(bP)
        
        if bP == "ceiling height" and paramValue != 0:
            roomObj.SetParameterByName(rP, paramValue)
            
        elif bP == "ceiling height" and paramValue == 0:
            height = boxObj.GetParameterValueByName("Height")
            roomObj.SetParameterByName(rP, height)
            
        elif bP == "Interior Finish":
            paramValue = boxObj.GetParameterValueByName(bP)
            paramValueSplitList = paramValue.split(",,")
            wallType = ','.join(
                list(filter(lambda x: x != "N/A",
                    paramValueSplitList[0].split(".."))))
            baseType = ','.join(
                list(filter(lambda x: x != "N/A",
                    paramValueSplitList[1].split(".."))))
            floorType = ','.join(
                list(filter(lambda x: x != "N/A",
                    paramValueSplitList[2].split(".."))))
            ceilType = ','.join(
                list(filter(lambda x: x != "N/A",
                    paramValueSplitList[3].split(".."))))
            
            roomObj.SetParameterByName("Wall Finish", wallType)
            roomObj.SetParameterByName("Base Finish", baseType)
            roomObj.SetParameterByName("Floor Finish", floorType)
            roomObj.SetParameterByName("Ceiling Finish", ceilType)
            roomObj.SetParameterByName(rP, paramValue)
        
        else:
            paramValue = boxObj.GetParameterValueByName(bP)
            roomObj.SetParameterByName(rP, paramValue)
    
    return roomDict
    


# Assign your output to the OUT variable.
OUT = map(lambda x: setRoomParameterValues(roomParamList, boxParamList, x), roomDicts)
# ----------------------------------------
setparameter_result = Watch(setRoomParameterValues)  # graph output
