# Dynamo graph 2-1_Room Separator(1206)_forCS.dyn (Dynamo 2.12.0.5650)

# group: Generic Mass & Level select
categories = Categories("OST_GenericModel")
all_elements_of_category = ElementsOfCategory(Category=categories)

# group: Box별 레벨 추출
code_block = CodeBlock { "Level"; }
getParameterValueByName = Element.GetParameterValueByName(element=all_elements_of_category, parameterName=code_block)
string_from_object = FromObject(object=getParameterValueByName)
uniqueItems = List.UniqueItems(list=string_from_object)
allIndicesOf = List.AllIndicesOf(list=string_from_object, item=uniqueItems)
getItemAtIndex = List.GetItemAtIndex(list=getParameterValueByName, index=allIndicesOf)

# group: 레벨 별 Box 정리
getItemAtIndex_2 = List.GetItemAtIndex(list=all_elements_of_category, index=allIndicesOf)  # frozen

# group: 매스 중점 포인트 추출 및 리스트 정리
getLocation = Element.GetLocation(element=getItemAtIndex_2)
flatten = List.Flatten(list=getLocation)
type = Object.Type(object=flatten)
firstItem = List.FirstItem(list=type)
removeIfNot = List.RemoveIfNot(list=getLocation@L2, type=firstItem)

count = List.Count(list=getItemAtIndex@L2)

# group: 작업평면 생성
byOriginNormal = Plane.ByOriginNormal(origin=getLocation)

geometry = Element.Geometry(element=getItemAtIndex_2)
flatten_2 = List.Flatten(list=geometry@L3)

# group: 매스 바닥면 추출 및 리스트 정리
intersect = Geometry.Intersect(geometry=byOriginNormal, other=flatten_2, lacing=Shortest)
flatten_3 = List.Flatten(list=intersect@L3)
clean = List.Clean(list=flatten_3)

# group: 매스별 바운더리 라인 추출 및 리스트 정리
perimeterCurves = Surface.PerimeterCurves(surface=clean)
clean_2 = List.Clean(list=perimeterCurves)
watch = Watch(clean_2)

list_flatten_매스별_바운더리_라인_추출_및 = List.Flatten(list=watch)  # "List.Flatten@매스별 바운더리 라인 추출 및 리스트 정리"

# group: 매스 집합의 최외곽선 추출(by Graham Scan)
startPoint = Curve.StartPoint(curve=watch)

# group: 포인트 중복제거
flatten_4 = List.Flatten(list=startPoint)
watch_2 = Watch(flatten_4)
string_from_object_2 = FromObject(object=watch_2)
중복제거 = Python(IN[0]=string_from_object_2)  # CPython3
# ---------- 중복제거.python (20 lines) ----------
# Load the Python Standard and DesignScript Libraries
import sys
import clr
clr.AddReference('ProtoGeometry')
from Autodesk.DesignScript.Geometry import *

# The inputs to this node will be stored as a list in the IN variables.
dataEnteringNode = IN
inList = IN[0]

# Place your code below this line
outList = []
for i in inList:
	if i in outList:
		pass
	else:
		outList.append(i)

# Assign your output to the OUT variable.
OUT = outList
# ----------------------------------------
allIndicesOf_2 = List.AllIndicesOf(list=string_from_object_2, item=중복제거)
firstItem_2 = List.FirstItem(list=allIndicesOf_2@L2)
getItemAtIndex_3 = List.GetItemAtIndex(list=flatten_4, index=firstItem_2)
flatten_5 = List.Flatten(list=getItemAtIndex_3)
Z = Point.Z(point=flatten_5)
uniqueItems_2 = List.UniqueItems(list=Z)
allIndicesOf_3 = List.AllIndicesOf(list=Z, item=uniqueItems_2)
getItemAtIndex_4 = List.GetItemAtIndex(list=flatten_5, index=allIndicesOf_3@L2)

# group (continued): 매스 집합의 최외곽선 추출(by Graham Scan)
graham_scan = Python(IN[0]=getItemAtIndex_4)  # CPython3
# ---------- graham_scan.python (67 lines) ----------
# Load the Python Standard and DesignScript Libraries
import sys
import clr
clr.AddReference('ProtoGeometry')
from Autodesk.DesignScript.Geometry import *
clr.AddReference('GeometryColor')
from Modifiers import GeometryColor
from functools import reduce

# The inputs to this node will be stored as a list in the IN variables.
dataEnteringNode = IN
inputPoints = IN[0]

class ConvexHull_Maker:
    def __init__(self, points):
        def convex_hull_graham(points):
            def ToVals(pt):
	            return [pt.X,pt.Y,pt.Z]
            def ToPts(ptVals):
	            return Point.ByCoordinates(ptVals[0],ptVals[1],ptVals[2])
	           
            def CreateOutline(pts):
                crvs = []
                i = 0
                while i < len(pts):
                    if i == len(pts)-1:
                        crvs.append(Line.ByStartPointEndPoint(pts[i],pts[0]))
                    else:
                        crvs.append(Line.ByStartPointEndPoint(pts[i],pts[i+1]))
                    i = i+1
                return PolyCurve.ByJoinedCurves(crvs)
	
            TURN_LEFT, TURN_RIGHT, TURN_NONE = (1, -1, 0)

            def cmp(a, b):
                return (a > b) - (a < b)
	
            def turn(p, q, r):
                return cmp((q[0] - p[0])*(r[1] - p[1]) - (r[0] - p[0])*(q[1] - p[1]), 0)
	
            def _keep_left(hull, r):
                while len(hull) > 1 and turn(hull[-2], hull[-1], r) != TURN_LEFT:
                    hull.pop()
                if not len(hull) or hull[-1] != r:
                    hull.append(r)
                return hull

            points = [ToVals(p) for p in points]	
            points = sorted(points)
            l = reduce(_keep_left, points, [])
            u = reduce(_keep_left, reversed(points), [])
            points = l.extend(u[i] for i in range(1, len(u) - 1)) or l
            points = [ToPts(p) for p in points]
            return CreateOutline(points)
            
        self.points = points
        result = convex_hull_graham(points)
        self.result = result
        
# Place your code below this line

result = []
for i in inputPoints:
    result.append(ConvexHull_Maker(i).result)

# Assign your output to the OUT variable.
OUT = result
# ----------------------------------------

# group: Room Separator 기준 되는 커브들 추출 및 단일 리스트 생성
watch_매스_집합의_최외곽선_추출_by_graham = Watch(graham_scan)  # "Watch@매스 집합의 최외곽선 추출(by Graham Scan)"
explode = Geometry.Explode(geometry=watch_매스_집합의_최외곽선_추출_by_graham)
join = List.Join(list0=list_flatten_매스별_바운더리_라인_추출_및, list1=explode)

# group: Curve 레벨 별 정렬
flatten_6 = List.Flatten(list=join)
startPoint_2 = Curve.StartPoint(curve=flatten_6)
Z_2 = Point.Z(point=startPoint_2)
uniqueItems_3 = List.UniqueItems(list=Z_2)
allIndicesOf_4 = List.AllIndicesOf(list=Z_2, item=uniqueItems_3)
getItemAtIndex_5 = List.GetItemAtIndex(list=flatten_6, index=allIndicesOf_4@L2)

작업평면 = CodeBlock(i=byOriginNormal) { i; }
firstItem_3 = List.FirstItem(list=작업평면@L2)
byPlane = SketchPlane.ByPlane(plane=firstItem_3)

# group: Room Separator 배치 기준 View 추출
categories_2 = Categories("OST_Views")
all_elements_of_category_2 = ElementsOfCategory(Category=categories_2)
isNull = Object.IsNull(object=all_elements_of_category_2)
filterByBoolMask = List.FilterByBoolMask(list=all_elements_of_category_2, mask=isNull)
string_from_object_3 = FromObject(object=filterByBoolMask.out)
code_block_2 = CodeBlock { "Floor"; }
contains = String.Contains(string=string_from_object_3, searchFor=code_block_2)
filterByBoolMask_2 = List.FilterByBoolMask(list=filterByBoolMask.out, mask=contains)
string_from_object_4 = FromObject(object=filterByBoolMask_2.in)
code_block_3 = CodeBlock()
# ---------- code_block_3.designscript (6 lines) ----------
[
"GROUND",
"1ST",
"2ND",
"3RD"
];
# ----------------------------------------
contains_2 = String.Contains(string=string_from_object_4, searchFor=code_block_3@L1)
code_block_4 = CodeBlock { true; }
allIndicesOf_5 = List.AllIndicesOf(list=contains_2@L2, item=code_block_4)
flatten_7 = List.Flatten(list=allIndicesOf_5)
getItemAtIndex_6 = List.GetItemAtIndex(list=filterByBoolMask_2.in, index=flatten_7)

restOfItems = List.RestOfItems(list=getItemAtIndex_6)

# group: RoomSeparator.FromCurve
code_block_5 = CodeBlock(i=getItemAtIndex_5, sketchPlane=byPlane, view=restOfItems) { i; sketchPlane; view; }
python_script = Python(IN[0]=code_block_5.i, IN[1]=code_block_5.sketchPlane, IN[2]=code_block_5.view)  # CPython3
# ---------- python_script.python (51 lines) ----------
import clr
clr.AddReference('RevitAPI')
from Autodesk.Revit.DB import *

clr.AddReference("RevitNodes")
import Revit
clr.ImportExtensions(Revit.GeometryConversion)

clr.AddReference("RevitServices")
import RevitServices
from RevitServices.Persistence import DocumentManager
from RevitServices.Transactions import TransactionManager

doc = DocumentManager.Instance.CurrentDBDocument
curveslist = UnwrapElement(IN[0])
sketchplaneslist = UnwrapElement(IN[1])
viewslist = UnwrapElement(IN[2])

def createRoomSeparator(curves, sketchplane, view):
    curvearray = CurveArray()
    for curve in curves:
    	curvearray.Append(curve.ToRevitType())
    doccreation = doc.Create
    separatorarray = doccreation.NewRoomBoundaryLines(sketchplane, curvearray, view)
    elementlist = []
    for item in separatorarray:
    	elementlist.append(item)
    
    return elementlist


TransactionManager.Instance.EnsureInTransaction(doc)

if len(curveslist) > 1:
    result = []
    for i in range(len(curveslist)):
        uni = createRoomSeparator(curveslist[i], sketchplaneslist[i], viewslist[i])
        result.append(uni)
else:
    result = createRoomSeparator(curveslist, sketchplaneslist, viewslist)

#result = createRoomSeparator(curveslist, sketchplaneslist, viewslist)

TransactionManager.Instance.TransactionTaskDone()
    





OUT = result
# ----------------------------------------
python_script_2 = Python()  # "Python Script@ReturnListOrSingleValue"; CPython3; frozen; unwired: IN[0], IN[1]
# ---------- python_script_2.python (4 lines) ----------
check = IN[0]
items = IN[1]
if isinstance(check, (list)): OUT = items
else: OUT = items[0]
# ----------------------------------------

code_block_6 = CodeBlock()
# ---------- code_block_6.designscript (7 lines) ----------
[
"G.L",
"2F",
"3F",
"4F",
"PF"
];
# ----------------------------------------
레벨_별_box_정리 = Python(IN[0]=all_elements_of_category)  # CPython3
# ---------- 레벨_별_box_정리.python (69 lines) ----------
# Load the Python Standard and DesignScript Libraries
import sys
import clr
clr.AddReference('ProtoGeometry')
from Autodesk.DesignScript.Geometry import *

clr.AddReference('RevitAPI')
from Autodesk.Revit.DB import *

clr.AddReference("RevitNodes")
import Revit
clr.ImportExtensions(Revit.GeometryConversion)

clr.AddReference("RevitServices")
import RevitServices
from RevitServices.Persistence import DocumentManager
from RevitServices.Transactions import TransactionManager

from collections import namedtuple
###################################################################################################
from functools import reduce
curry = lambda f: lambda a,*args: f(a, *args) if (len(args)) else lambda *args: f(a, *args)

filter = curry(filter)
map = curry(map)
reduce = curry(reduce)

def _take(length, iter):
    res = []
    for a in iter:
        res.append(a)
        if len(res) == length:
            return res
take = curry(_take)


go = lambda *args: reduce(lambda a,f: f(a), args) ## 함수도 축약 가능 ##
###################################################################################################

# The inputs to this node will be stored as a list in the IN variables.
dataEnteringNode = IN
inputs = IN[0]
# Place your code below this line
getUniqLvFunc = lambda _list: go\
(
    _list,
    map(lambda x: x.GetParameterValueByName("Level")),
    set,
)

uniqLvs = getUniqLvFunc(inputs)

def makeBoxGroupByKeys(_list, keys):
    def filterByKey(_list, key):
        mkNamedTuple = namedtuple('boxBylv', 'level, boxes')
        func = lambda _list: go\
            (_list,
            filter(lambda x: x.GetParameterValueByName("Level") == key),
            list)
        value = func(_list)
        return {str(key): value}
#        return mkNamedTuple(level=key, boxes = value)
    res = map(lambda x: filterByKey(_list, x), keys)
    return res#reduce(lambda x,y: y.update(x), res, dict())


result = makeBoxGroupByKeys(inputs, uniqLvs)
# Assign your output to the OUT variable.
OUT = result
# ----------------------------------------
parameters = Element.Parameters(element=getItemAtIndex_6)
view_family_types = ViewFamilyTypes("Floor Plan")
views = Views("##AR 3D")
parameters_2 = Element.Parameters(element=filterByBoolMask_2.in)
watch_3 = Watch(parameters_2)
code_block_7 = CodeBlock { "Family"; "Family and Type"; }
getParameterValueByName_2 = Element.GetParameterValueByName(element=filterByBoolMask_2.in, parameterName=code_block_7.out1)
매스_중점_포인트_추출 = Python(IN[0]=all_elements_of_category)  # CPython3
# ---------- 매스_중점_포인트_추출.python (79 lines) ----------
# Load the Python Standard and DesignScript Libraries
import sys
import clr
clr.AddReference('RevitAPI')
from Autodesk.Revit.DB import *

clr.AddReference("RevitNodes")
import Revit
clr.ImportExtensions(Revit.GeometryConversion)

clr.AddReference("RevitServices")
import RevitServices
from RevitServices.Persistence import DocumentManager
from RevitServices.Transactions import TransactionManager

clr.AddReference('ProtoGeometry')
from Autodesk.DesignScript.Geometry import *

from collections import namedtuple
###################################################################################################
from functools import reduce
curry = lambda f: lambda a,*args: f(a, *args) if (len(args)) else lambda *args: f(a, *args)

filter = curry(filter)
map = curry(map)
reduce = curry(reduce)

def _take(length, iter):
    res = []
    for a in iter:
        res.append(a)
        if len(res) == length:
            return res
take = curry(_take)


go = lambda *args: reduce(lambda a,f: f(a), args) ## 함수도 축약 가능 ##
###################################################################################################

# The inputs to this node will be stored as a list in the IN variables.
dataEnteringNode = IN
inputs = IN[0]
# Place your code below this line

def main(inputs):
    
    composedFunc1 = lambda _list,_nV: go\
    (
        _list,
        map(lambda x: x.GetLocation()),
        map(lambda x: Plane.ByOriginNormal(x, _nV)),
    )
    
    getBtmSurfs = lambda _list: go\
    (
        _list,
        map(lambda x: x.Geometry()[0]),
        map(lambda x: x.Explode()),
        map(lambda x: 
            filter(lambda y: y.NormalAtParameter(0.5,0.5).Z == -1, x)),
        lambda x: list(zip(*x))[0]
        
    )
    btmSurfs = getBtmSurfs(inputs)
    
    getBoundaryOfSurfs = lambda _list: go\
    (
        _list,
        map(lambda x: x.GetLocation()),
    )
    
    
    
    return getBtmSurfs(inputs)


result = main(inputs)
# Assign your output to the OUT variable.
OUT = result
# ----------------------------------------
