# Dynamo graph 1_Mass Arrangement (by Building List)(0706).dyn "1_Mass Arrangement (by Building List)(0705)" (Dynamo 2.10.1.3976)
# packages: Clockwork for Dynamo 2.x 2.3.0, Ampersand 2019.12.31

# note: pick the level the families
# should populate on
levels = Levels("GF")  # graph input
# note: select the space planning family with the corresponding parameters to be overwritten by Dynamo
family_types = FamilyTypes("Space Planning Box_hec:Space Planning Box_hec")  # graph input

# group: INPUT - EXCEL: change file path to programming .xls file
file_path = Filename(".\hec_Space Planning_sample Program(0701).xlsx")  # graph input

fromPath = FileObject(path=file_path)  # "File.FromPath"
code_block = CodeBlock { "Sheet1"; }
boolean = BoolSelector(false)
# note: read excel file, pull
# from sheet in string
importExcel = Data.ImportExcel(file=fromPath, sheetName=code_block, showExcel=boolean)
# note: skip first row,
# column headers
restOfItems = List.RestOfItems(list=importExcel)

# group: SORTING: This sequence of nodes extracts the values from the WIDTH column in the Excel file
# note: flip data to be grouped
# by column not row
transpose = List.Transpose(lists=restOfItems)
# note: select only items in index 7
# (WIDTH column)
code_block_2 = CodeBlock(IN=transpose) { IN[7]; }

# note: flips data to be grouped
# by column not row
transpose_2 = List.Transpose(lists=restOfItems)
# note: selects only items in index 3
# (QUANTITY column)
code_block_3 = CodeBlock(IN=transpose_2) { IN[3]; }

# group: Multiplying instances of WIDTH by the QUANTITY column from spreadsheet
# note: multiplies each Department
# by the associated value in the
# QUANTITY column from the
# Excel file
ofRepeatedItem = List.OfRepeatedItem(item=code_block_2@L1, amount=code_block_3@L1)
# note: consolidate all sublist
# groups into one seamless list
flatten = List.Flatten(list=ofRepeatedItem)

# group: SORTING: This sequence of creates a new list of sequential unique index number to later be paired with all Department values from the Excel spreadsheet
# note: From Clockwork package:
# Counts number of times each
# unique item (department) occurs.
# Output:
# 1. list of unique items
# 2. number of occurences
# note: From LunchBox package:
# Recursive Function -
# adds each item in the list
# to the sum of the values
# before it until the list is
# exhausted.
code_block_4 = CodeBlock { 0; }
# note: flips data to be grouped
# by column not row
transpose_3 = List.Transpose(lists=restOfItems)
# note: select only items in index 1
# (DEPARTMENT column)
code_block_5 = CodeBlock(IN=transpose_3) { IN[9]; }

# group: Accounting for QUANTITY column from spreadsheet
# note: multiplies each Department
# by the associated value in the
# QUANTITY column from the
# Excel file
ofRepeatedItem_2 = List.OfRepeatedItem(item=code_block_5@L1, amount=code_block_3@L1)
# note: consolidate all sublist
# groups into one seamless list
flatten_2 = List.Flatten(list=ofRepeatedItem_2)

countOccurences = Custom[List.CountOccurences](seq=flatten_2)  # package Clockwork for Dynamo 2.x; Counts the number of occurences of each unique element in a given list
python_script = Python(IN[0]=countOccurences.count)  # IronPython2
# ---------- python_script.python (22 lines) ----------
# Load the Python Standard and DesignScript Libraries
import sys
import clr
clr.AddReference('ProtoGeometry')
from Autodesk.DesignScript.Geometry import *

# The inputs to this node will be stored as a list in the IN variables.
dataEnteringNode = IN
inList = IN[0]
outList = []

# Place your code below this line
acc = 0
for i in inList:
	acc = acc + i
	outList.append(acc)
	



# Assign your output to the OUT variable.
OUT = outList
# ----------------------------------------

# group (continued): SORTING: This sequence of creates a new list of sequential unique index number to later be paired with all Department values from the Excel spreadsheet
# note: Adds 0 to the front
# of the list so every
# count starts at 0
addItemToFront = List.AddItemToFront(item=code_block_4, list=python_script)
# note: Since 0 is included as an index,
# need to reduce the list by 1 to
# maintain the actual number of
# items
code_block_6 = CodeBlock(x=python_script) { x-1; }
# note: Assigns a unique number
#  to each Department
# occurence
code_block_7 = CodeBlock(x=addItemToFront, y=code_block_6) { x..y; }

# note: regroups the Width values
# by Department count
getItemAtIndex = List.GetItemAtIndex(list=flatten, index=code_block_7)

# group: INPUT - SPACER: this number sets the even distance between all space planning families for both Width AND Height
integer_slider_spacer = IntegerSlider(20000, range=0..20000 step 5)  # graph input

code_block_8 = CodeBlock(SPACER=integer_slider_spacer) { SPACER; }

# group: SORTING: This sequence of nodes extracts the values from the LENGTH column in the Excel file
# note: flip data to be grouped
# by column not row
transpose_4 = List.Transpose(lists=restOfItems)
# note: select only items in index 6
# (LENGTH column)
code_block_9 = CodeBlock(IN=transpose_4) { IN[6]; }

# group: Multiplying instances of LENGTH by the QUANTITY column from spreadsheet
# note: multiplies each Department
# by the associated value in the
# QUANTITY column from the
# Excel file
ofRepeatedItem_3 = List.OfRepeatedItem(item=code_block_9@L1, amount=code_block_3@L1)
# note: consolidate all sublist
# groups into one seamless list
flatten_3 = List.Flatten(list=ofRepeatedItem_3)

# note: regroups the Length values
# by Department count
getItemAtIndex_2 = List.GetItemAtIndex(list=flatten_3, index=code_block_7)

# group: SPACING: Using Recursive function to evenly space centroid coordinates based on program widths from spreadsheet.
# note: "helper node":
# re-positioning for
# cleaning up canvas
code_block_10 = CodeBlock(list=getItemAtIndex) { list; }
# note: cut all Width values in half
code_block_11 = CodeBlock(a=code_block_10) { a/2; }
code_block_12 = CodeBlock { 1; }
# note: rotate all values in list
# by one position...
# end comes front,
# everything else moves
# down one index
shiftIndices = List.ShiftIndices(list=code_block_11@L2, amount=code_block_12)
# note: buffer: two mapped nodes
# in a row made the second
# function replace an additional
# index... this fixes glitch
code_block_13 = CodeBlock(x=shiftIndices) { x; }
code_block_14 = CodeBlock { 0; }
# note: replace the first item in
# each sublist with 0 as
# starting position for the
# first point
replaceItemAtIndex = List.ReplaceItemAtIndex(list=code_block_13@L2, index=code_block_14, item=code_block_14)
# note: count the number of
# items in every sublist
count = List.Count(list=code_block_10@L2)
# note: Since 0 is included as an index,
# need to reduce the list by 1 to
# maintain the actual number of
# items
code_block_15 = CodeBlock(n=count) { n-1; }
# note: copy the spacer value
# as many times as the
# number of items in
# every sublist
ofRepeatedItem_4 = List.OfRepeatedItem(item=code_block_8, amount=code_block_15)
code_block_16 = CodeBlock { 0; }
# note: replace the first item in
# each sublist with 0 so the
# spacing occurs after the
# first instance
insert = List.Insert(list=ofRepeatedItem_4@L2, element=code_block_16, index=code_block_16)
# note: pair the three lists together:
# 1. half the width values from the first item
# 2. half the width values from the next item
# 3. the space value between points
code_block_17 = CodeBlock(a=code_block_11, b=replaceItemAtIndex, c=insert) { [a,b,c]; }
# note: these Transpose functions re-sort the sublist so that the values are grouped by individual width values for each point
transpose_5 = List.Transpose(lists=code_block_17)
transpose_6 = List.Transpose(lists=transpose_5@L3)
# note: sum each with sublist
# to get total point distance
# note: From LunchBox package:
# Recursive Function -
# adds each item in the list
# to the sum of the values
# before it until the list is
# exhausted...
# Spaces each point along the X Axis
sum = Math.Sum(values=transpose_6)
# note: Collect the largest Length value
maximumItem = List.MaximumItem(list=getItemAtIndex_2)
# note: cut all Length values in half
code_block_18 = CodeBlock(a=maximumItem) { [a/2]; }
# note: consolidate all sublist
# groups into one seamless list
flatten_4 = List.Flatten(list=code_block_18)
code_block_19 = CodeBlock { 1; }
shiftIndices_2 = List.ShiftIndices(list=flatten_4, amount=code_block_19)
code_block_20 = CodeBlock { 0; }
# note: replace with 0 as
# starting position for
# the first point
replaceItemAtIndex_2 = List.ReplaceItemAtIndex(list=shiftIndices_2, index=code_block_20, item=code_block_20)
count_2 = List.Count(list=maximumItem)
code_block_21 = CodeBlock(n=count_2) { n-1; }
ofRepeatedItem_5 = List.OfRepeatedItem(item=code_block_8, amount=code_block_21)
code_block_22 = CodeBlock { 0; }
insert_2 = List.Insert(list=ofRepeatedItem_5, element=code_block_22, index=code_block_22)
# note: pair the three lists together:
# 1. half the length values from the first item
# 2. half the length values from the next item
# 3. the space value between points
code_block_23 = CodeBlock(a=flatten_4, b=replaceItemAtIndex_2, c=insert_2) { [a,b,c]; }
# note: this Transpose function re-sorts the sublist so that the values are grouped by individual width values for each point
transpose_7 = List.Transpose(lists=code_block_23)
sum_2 = Math.Sum(values=transpose_7)

python_script_2 = Python(IN[0]=sum)  # IronPython2
# ---------- python_script_2.python (27 lines) ----------
# Load the Python Standard and DesignScript Libraries
import sys
import clr
clr.AddReference('ProtoGeometry')
from Autodesk.DesignScript.Geometry import *

# The inputs to this node will be stored as a list in the IN variables.
dataEnteringNode = IN
inList = IN[0]
outList = []

# Place your code below this line


for i in inList:
	acc = 0
	for j in i:
		acc = acc + j
		outList.append(acc)
#	for j in i:
#		acc = acc + j
#		outList.append([acc])



# Assign your output to the OUT variable.
OUT = outList
# ----------------------------------------
count_3 = List.Count(list=sum@L2)
chop = List.Chop(list=python_script_2, lengths=count_3)
python_script_3 = Python(IN[0]=sum_2)  # IronPython2; same code as python_script
element_types = ElementTypes("Level")
all_elements_of_type = ElementsOfType(element_type=element_types)
count_4 = List.Count(list=chop@L2)
ofRepeatedItem_6 = List.OfRepeatedItem(item=all_elements_of_type, amount=count_4, lacing=Longest)

# group: INSTANTIATION: Placing Space Planning family at centroid coordinates.
byCoordinates = Point.ByCoordinates(x=chop)
byCoordinates_2 = Vector.ByCoordinates(y=python_script_3)
# note: Create points according to the
# calculated Width values along
# the X Axis...
# Locate the points along the
# Y Axis according to the calculated
# Length values
add = Point.Add(point=byCoordinates@L2, vectorToAdd=byCoordinates_2@L1)
# note: places an instance of the family
# at each point location
byPointAndLevel = FamilyInstance.ByPointAndLevel(familyType=family_types, point=add, level=ofRepeatedItem_6)

# group: This group of nodes accounts for the increase of all columns in the Excel spreadsheet according to values in the QUANTITY column
# note: consolidate all columns from
# the Excel spreadsheet into
# one seamless list
flatten_5 = List.Flatten(list=transpose_2)
# note: counts the total number of columns
# from the Excel spreadsheet
count_5 = List.Count(list=transpose_2)
# note: creates copies of the
# QUANTITY list based on
# the total number of columns
ofRepeatedItem_7 = List.OfRepeatedItem(item=code_block_3, amount=count_5)
flatten_6 = List.Flatten(list=ofRepeatedItem_7)
# note: multiplies each column in the
# Excel file by the same number
# from the QUANTITY column
ofRepeatedItem_8 = List.OfRepeatedItem(item=flatten_5@L1, amount=flatten_6@L1)
# note: consolidate all sublist
# groups into one seamless list
flatten_7 = List.Flatten(list=ofRepeatedItem_8)
# note: counts the total number of
# items in each column after
# recalculating for quanity
count_6 = List.Count(list=flatten_2)
# note: breaks the list back into separate
# sublists based on each column
# category
chop_2 = List.Chop(list=flatten_7, lengths=count_6)

code_block_24 = CodeBlock(IN=chop_2) { IN[9]; }

# group: SORTING: Re-sorting all categories from the spreadsheet into sublists according to unique Departments
# note: From the Clockwork package:
# count all unique Departments
# note: select only items in index 1
# (DEPARTMENT column)
countOccurences_2 = Custom[List.CountOccurences](seq=code_block_24)
# note: From Ampersand package:
# resort each column by the
# number of items in each
# unique Department
list_chopbylengths = Custom[[&] List.ChopByLengths](list=chop_2@L2, lengths=countOccurences_2.count)  # package Ampersand; Chop a list into sublists given a series of sizes. Remaining list items after the sublists have been filled are discarded. Remaining sublist capacity after list items are exhausted is ignored.

code_block_25 = CodeBlock(x=list_chopbylengths) { x; }

# group: PARAMETERS & COLOR: Setting the parameter values in the space planning families. Changing color of each family instance by associated Department.
code_block_26 = CodeBlock { "Width"; }
code_block_27 = CodeBlock(x=code_block_25) { x; }
number = DoubleInput(7)  # graph input
list_getitematindex_width = List.GetItemAtIndex(list=code_block_27, index=number)
setParameterByName = Element.SetParameterByName(element=byPointAndLevel, parameterName=code_block_26, value=list_getitematindex_width)
code_block_28 = CodeBlock { "Length"; }
number_2 = DoubleInput(6)  # graph input
list_getitematindex_length = List.GetItemAtIndex(list=code_block_27, index=number_2)
setParameterByName_2 = Element.SetParameterByName(element=byPointAndLevel, parameterName=code_block_28, value=list_getitematindex_length)
code_block_29 = CodeBlock { "Department"; }
number_3 = DoubleInput(1)  # graph input
# note: these nodes are querying specific
# sublist in order to populate
# parameters in the space planning
# families
list_getitematindex_department = List.GetItemAtIndex(list=code_block_27, index=number_3)
# note: this series of nodes assigns
# the selected sublists to certain
# parameters in the space planning
# family
setParameterByName_3 = Element.SetParameterByName(element=byPointAndLevel, parameterName=code_block_29, value=list_getitematindex_department)
code_block_30 = CodeBlock { "Program Area"; }
number_4 = DoubleInput(2)  # graph input
list_getitematindex_prog_area = List.GetItemAtIndex(list=code_block_27, index=number_4)
setParameterByName_4 = Element.SetParameterByName(element=byPointAndLevel, parameterName=code_block_30, value=list_getitematindex_prog_area)
code_block_31 = CodeBlock { "Room Name"; }
number_5 = DoubleInput(0)  # graph input
list_getitematindex_space_room = List.GetItemAtIndex(list=code_block_27, index=number_5)
setParameterByName_5 = Element.SetParameterByName(element=byPointAndLevel, parameterName=code_block_31, value=list_getitematindex_space_room)
code_block_32 = CodeBlock { "Height"; }
number_6 = DoubleInput(5)  # graph input
list_getitematindex_height = List.GetItemAtIndex(list=code_block_27, index=number_6)
setParameterByName_6 = Element.SetParameterByName(element=byPointAndLevel, parameterName=code_block_32, value=list_getitematindex_height)
flatten_8 = List.Flatten(list=byPointAndLevel)
code_block_33 = CodeBlock { "Fill Color"; }
number_7 = DoubleInput(8)  # graph input
list_getitematindex_fill_color = List.GetItemAtIndex(list=code_block_27, index=number_7)
# note: This list assigns a name to the RGB
# color values in the Code Block below.
# These color names also correspond to
# the colors from the COLOR column in
# the Excel spreadsheet.
code_block_34 = CodeBlock { "Gray"; "Pink"; "Magenta"; "Purple"; "Lavender"; "Blue"; "Cyan"; "Teal"; "Green"; "Lime"; "Yellow"; "Orange"; "Red"; }
create = List.Create(item0=code_block_34.out0, item1=code_block_34.out1, item2=code_block_34.out2, item3=code_block_34.out3, item4=code_block_34.out4, item5=code_block_34.out5, item6=code_block_34.out6, item7=code_block_34.out7, item8=code_block_34.out8, item9=code_block_34.out9, item10=code_block_34.out10, item11=code_block_34.out11, item12=code_block_34.out12)
matchWithKeyValues = Custom[List.MatchWithKeyValues](seq=list_getitematindex_fill_color, keys=create, values=create)  # package Clockwork for Dynamo 2.x; Matches a list with a given set of keys and returns the values corresponding to the keys
byName = Material.ByName(name=matchWithKeyValues)
# note: this node colorizes each box
# according to the Deparment
# list by replacing the material
# ("Fill Color")
setParameterByName_7 = Element.SetParameterByName(element=flatten_8, parameterName=code_block_33, value=byName)

elevation = Level.Elevation(level=ofRepeatedItem_6)
code_block_35 = CodeBlock { "Interior Finish"; }
number_8 = DoubleInput(10)  # graph input
list_getitematindex_interior = List.GetItemAtIndex(list=code_block_27, index=number_8)  # "List.GetItemAtIndex - Interior Finish"
setParameterByName_8 = Element.SetParameterByName(element=byPointAndLevel, parameterName=code_block_35, value=list_getitematindex_interior)
code_block_36 = CodeBlock { "Exterior Finish"; }
number_9 = DoubleInput(11)  # graph input
list_getitematindex_interior_2 = List.GetItemAtIndex(list=code_block_27, index=number_9)  # "List.GetItemAtIndex - Interior Finish"
setParameterByName_9 = Element.SetParameterByName(element=byPointAndLevel, parameterName=code_block_36, value=list_getitematindex_interior_2)
code_block_37 = CodeBlock { "Elevation from Level"; 0; }
setParameterByName_10 = Element.SetParameterByName(element=byPointAndLevel, parameterName=code_block_37.out0, value=code_block_37.out1)
