# Dynamo graph 0624 Mass boundary auto modeling test 001_mk.dyn (Dynamo 2.6.1.8786)
# packages: Clockwork for Dynamo 2.x 2.3.0, archi-lab.net 2021.25.11, MEPover 2020.6.2

categories = Categories("OST_GenericModel")
all_elements_of_category = ElementsOfCategory(Category=categories)
levels = Levels("2nd")
name = Level.Name(level=levels)
watch = Watch(name)
code_block = CodeBlock { "Level"; }
getParameterValueByName = Element.GetParameterValueByName(element=all_elements_of_category, parameterName=code_block)
name_2 = Level.Name(level=getParameterValueByName)
watch_2 = Watch(name_2)
eq = watch == watch_2
watch_3 = Watch(eq)
filterByBoolMask = List.FilterByBoolMask(list=all_elements_of_category, mask=watch_3)
watch_4 = Watch(filterByBoolMask.in)
getLocation = Element.GetLocation(element=watch_4)
byBestFitThroughPoints = Plane.ByBestFitThroughPoints(points=getLocation@L1)
sort = List.Sort()  # unwired: list
byStartPointEndPoint = Line.ByStartPointEndPoint(endPoint=sort, lacing=CrossProduct)  # unwired: startPoint
flatten = List.Flatten(list=byStartPointEndPoint)
firstItem = List.FirstItem(list=getLocation)
byOriginNormal = Plane.ByOriginNormal(origin=firstItem)
geometry = Element.Geometry(element=watch_4)
intersect = Geometry.Intersect(geometry=byOriginNormal, other=geometry)
flatten_2 = List.Flatten(list=intersect)
clean = List.Clean(list=flatten_2)
perimeterCurves = Surface.PerimeterCurves(surface=clean)
clean_2 = List.Clean(list=perimeterCurves)
watch_5 = Watch(clean_2)
flatten_3 = List.Flatten(list=watch_5)
type = Object.Type(obj=getLocation)
firstItem_2 = List.FirstItem(list=type)
removeIfNot = List.RemoveIfNot(list=getLocation, type=firstItem_2)
python_script = Python(IN[0]=removeIfNot)
# ---------- python_script.python (55 lines) ----------
import clr
clr.AddReference('ProtoGeometry')
from Autodesk.DesignScript.Geometry import *

def ToVals(pt):
	return [pt.X,pt.Y,pt.Z]

def ToPts(ptVals):
	return Point.ByCoordinates(ptVals[0],ptVals[1],ptVals[2])

def CreateOutline(pts):
	crvs = []
	i = 0
	while i < len(pts):
		if i == len(pts)-1:
			crvs.append(Line.ByStartPointEndPoint(pts[i],pts[0]))
		else:
			crvs.append(Line.ByStartPointEndPoint(pts[i],pts[i+1]))
		i = i+1
	return PolyCurve.ByJoinedCurves(crvs)

'''
Taken from Thomas Switzers awesome GitHub repo and modified to suit Dynamo Context
https://gist.github.com/arthur-e/5cf52962341310f438e96c1f3c3398b8
I take zero credit for this work other than porting it across.
'''
def convex_hull_graham(points):
	'''
	Returns points on convex hull in CCW order according to Graham's scan algorithm. 
	By Tom Switzer <thomas.switzer@gmail.com>.
	'''
	TURN_LEFT, TURN_RIGHT, TURN_NONE = (1, -1, 0)

	def cmp(a, b):
		return (a > b) - (a < b)
	
	def turn(p, q, r):
		return cmp((q[0] - p[0])*(r[1] - p[1]) - (r[0] - p[0])*(q[1] - p[1]), 0)
	
	def _keep_left(hull, r):
		while len(hull) > 1 and turn(hull[-2], hull[-1], r) != TURN_LEFT:
			hull.pop()
		if not len(hull) or hull[-1] != r:
			hull.append(r)
		return hull

	points = [ToVals(p) for p in points]	
	points = sorted(points)
	l = reduce(_keep_left, points, [])
	u = reduce(_keep_left, reversed(points), [])
	points = l.extend(u[i] for i in range(1, len(u) - 1)) or l
	points = [ToPts(p) for p in points]
	return CreateOutline(points)

OUT = convex_hull_graham(IN[0])
# ----------------------------------------
doesIntersect = Geometry.DoesIntersect(geometry=python_script, other=flatten_3)
filterByBoolMask_2 = List.FilterByBoolMask(list=flatten_3, mask=doesIntersect)
ZAxis = Vector.ZAxis()
code_block_2 = CodeBlock { 1000; }
extrude = Curve.Extrude(curve=filterByBoolMask_2.in, direction=ZAxis, distance=code_block_2)
code_block_3 = CodeBlock { 300; }
thicken = Surface.Thicken(surface=extrude, thickness=code_block_3)
code_block_4 = CodeBlock { 200; }
byARGB = Color.ByARGB(a=code_block_4, r=code_block_4)
byGeometryColor = Modifiers.GeometryColor.ByGeometryColor(geometry=thicken, color=byARGB)
ZAxis_2 = Vector.ZAxis()
code_block_5 = CodeBlock { 1000; }
extrude_2 = Curve.Extrude(curve=filterByBoolMask_2.out, direction=ZAxis_2, distance=code_block_5)
code_block_6 = CodeBlock { 500; }
thicken_2 = Surface.Thicken(surface=extrude_2, thickness=code_block_6)
byARGB_2 = Color.ByARGB(a=code_block_4, g=code_block_4)
byGeometryColor_2 = Modifiers.GeometryColor.ByGeometryColor(geometry=thicken_2, color=byARGB_2)
byPatch = Surface.ByPatch(closedCurve=python_script)
doesIntersect_2 = Geometry.DoesIntersect(geometry=byPatch, other=flatten_3)
filterByBoolMask_3 = List.FilterByBoolMask(list=flatten_3, mask=doesIntersect_2)
ZAxis_3 = Vector.ZAxis()
code_block_7 = CodeBlock { 1000; }
extrude_3 = Curve.Extrude(curve=filterByBoolMask_3.out, direction=ZAxis_3, distance=code_block_7)
code_block_8 = CodeBlock { 500; }
thicken_3 = Surface.Thicken(surface=extrude_3, thickness=code_block_8)
code_block_9 = CodeBlock { 200; }
byARGB_3 = Color.ByARGB(a=code_block_9, g=code_block_9)
byGeometryColor_3 = Modifiers.GeometryColor.ByGeometryColor(geometry=thicken_3, color=byARGB_3)
ZAxis_4 = Vector.ZAxis()
code_block_10 = CodeBlock { 1000; }
extrude_4 = Curve.Extrude(curve=filterByBoolMask_3.in, direction=ZAxis_4, distance=code_block_10)
code_block_11 = CodeBlock { 300; }
thicken_4 = Surface.Thicken(surface=extrude_4, thickness=code_block_11)
byARGB_4 = Color.ByARGB(a=code_block_9, r=code_block_9)
byGeometryColor_4 = Modifiers.GeometryColor.ByGeometryColor(geometry=thicken_4, color=byARGB_4)

# group: Surface - 내/외부 Line 추출
code_block_12 = CodeBlock {  }
code_block_13 = CodeBlock {  }

# group: Polycurve - 내/외부 Line 추출
code_block_14 = CodeBlock {  }
code_block_15 = CodeBlock {  }

startPoint = Curve.StartPoint(curve=watch_5)

# group: 겹친점 제거
flatten_4 = List.Flatten(list=startPoint)
watch_6 = Watch(flatten_4)
string_from_object = FromObject(obj=watch_6)
python_script_2 = Python(IN[0]=string_from_object)
# ---------- python_script_2.python (20 lines) ----------
# Load the Python Standard and DesignScript Libraries
import sys
import clr
clr.AddReference('ProtoGeometry')
from Autodesk.DesignScript.Geometry import *

# The inputs to this node will be stored as a list in the IN variables.
dataEnteringNode = IN
inList = IN[0]

# Place your code below this line
outList = []
for i in inList:
	if i in outList:
		pass
	else:
		outList.append(i)

# Assign your output to the OUT variable.
OUT = outList
# ----------------------------------------
allIndicesOf = List.AllIndicesOf(list=string_from_object, item=python_script_2)
firstItem_3 = List.FirstItem(list=allIndicesOf@L2)
getItemAtIndex = List.GetItemAtIndex(list=flatten_4, index=firstItem_3)

python_script_3 = Python(IN[0]=getItemAtIndex)  # same code as python_script

# group: 외부 인식
byPatch_2 = Surface.ByPatch(closedCurve=python_script_3)
watch_7 = Watch(clean)
byJoinedSurfaces = PolySurface.ByJoinedSurfaces(surfaces=watch_7)
difference = Surface.Difference(surface=byPatch_2, others=byJoinedSurfaces)
doesIntersect_3 = Geometry.DoesIntersect(geometry=flatten_3, other=difference)
filterByBoolMask_4 = List.FilterByBoolMask(list=flatten_3, mask=doesIntersect_3)

flatten_5 = List.Flatten(list=filterByBoolMask_4.in)
flatten_6 = List.Flatten(list=filterByBoolMask_4.out)
pullOntoPlane = Curve.PullOntoPlane()  # unwired: curve, plane
code_block_16 = CodeBlock { "Point"; }
watch_8 = Watch(python_script_3)
explode = Geometry.Explode(geometry=watch_8)
join = List.Join(list0=filterByBoolMask_3.in, list1=filterByBoolMask_3.out, list2=explode)
watch_9 = Watch(byOriginNormal)
byPlane = SketchPlane.ByPlane(plane=watch_9)
views = Views("2nd")
watch_10 = Watch(views)
fromCurve = Custom[RoomSeparator.FromCurve](curve=join, sketchPlane=byPlane, view=watch_10)  # frozen; package Clockwork for Dynamo 2.x; Creates room separation lines from geometry curves.
categories_2 = Categories("OST_Rooms")
all_elements_of_category_2 = ElementsOfCategory(Category=categories_2)
geometry_2 = Element.Geometry(element=all_elements_of_category_2)
watch_11 = Watch(filterByBoolMask.out)
elevation = Level.Elevation(level=levels)
delete = archilab.Revit.Elements.Elements.Delete()  # unwired: element
select_phase = RevitPhases()  # nothing selected
rooms_place_automatically_for = Custom[Rooms place automatically for all levels](Phase=select_phase)  # package MEPover; This node will attempt to create rooms automatically for every level
spaces_place_automatically_for = Custom[Spaces place automatically for all levels](Phase=select_phase)  # package MEPover; This node will attempt to create spaces automatically for every level
group_curves = Custom[Group Curves]()  # package archi-lab.net; This node will take any input of flat list of curves and group them into sublists containing "joinable" curves that is continous curves. They might form closed curves or open curves. Use PolyCurve.ByJoinedCurves to convert output groups of curves into single PolyCurves; unwired: curves
boundaries = Custom[Room.Boundaries](room=all_elements_of_category_2)  # package archi-lab.net; This node returns all Room bounding curves and elements that generated them (walls, separation lines etc).
geometry_3 = Element.Geometry(element=boundaries.element)
coreBoundary = Room.CoreBoundary(room=all_elements_of_category_2)
code_block_17 = CodeBlock { 1; }
flatten_7 = List.Flatten(list=coreBoundary, amt=code_block_17)
startPoint_2 = Curve.StartPoint(curve=flatten_7)
boolean = BoolSelector(true)
byPoints = PolyCurve.ByPoints(points=startPoint_2, connectLastToFirst=boolean)
byPatch_3 = Surface.ByPatch(closedCurve=byPoints)
python_script_4 = Python()  # unwired: IN[0]
# ---------- python_script_4.python (49 lines) ----------
import clr

clr.AddReference("RevitServices")
import RevitServices
from RevitServices.Persistence import DocumentManager
from RevitServices.Transactions import TransactionManager
doc = DocumentManager.Instance.CurrentDBDocument

clr.AddReference("RevitAPI")
import Autodesk
from Autodesk.Revit.DB import *

clr.AddReference("RevitNodes")
import Revit
clr.ImportExtensions(Revit.Elements)
clr.ImportExtensions(Revit.GeometryConversion)

collector = FilteredElementCollector(doc)
levels = collector.OfClass(Level).ToElements()

phase = UnwrapElement(IN[0])
limitoffset = 8
listout = []

for j,level in enumerate(levels):
	try:
		planTopology = doc.get_PlanTopology(level)
		rooms = []
		
		for i,plancircuit in enumerate(planTopology.Circuits):
			if plancircuit.IsRoomLocated == True:
				continue
			TransactionManager.Instance.EnsureInTransaction(doc)
			room = doc.Create.NewRoom(phase)
			room.Name = "Name" + str(i)
			room.Number = str(j) + "." + str(i)
			room.LimitOffset = limitoffset
			try:
				room2 = doc.Create.NewRoom(room,plancircuit)
			except:
				continue
			TransactionManager.Instance.TransactionTaskDone()
			rooms.append(room2)
		listout.append(rooms)
	except:
		continue


OUT = listout
# ----------------------------------------
