# Dynamo graph 0825 space planning test_mk.dyn (Dynamo 2.10.1.3976)
# packages: GenerativeDesign.Revit 1.7.3.0, GenerativeDesign 1.7.3.0

# group: User Inputs for GDIR
# note: Custom Package: GenerativeDesign v.2021.5.5
select_room_to_load_program_into = DSModelRoomSelection()  # 1 picked in the model; graph input
# note: Retrieve the room's finish boundary.
# Note: The first sublist is the outermost boundary of the room.
finishBoundary = Room.FinishBoundary(room=select_room_to_load_program_into)
remember = Data.Remember(finishBoundary)

# group: Extract room boundary for DynaSpace and cache it in the graph
firstItem = List.FirstItem(list=remember@L3)
startPoint = Curve.StartPoint(curve=firstItem)
flatten = List.Flatten(list=startPoint)
byJoinedCurves = PolyCurve.ByJoinedCurves(curves=firstItem)
code_block = CodeBlock(BldgBoundary=byJoinedCurves)
# ---------- code_block.designscript (3 lines) ----------
{
"BldgBoundary": _BldgBoundary
};
# ----------------------------------------

# group: 고정부 Seed
seed_고정부_코어 = DoubleSlider(404, range=0..999 step 1)  # graph input

# group: 변동부 Seed
seed_변형부_공간 = DoubleSlider(277, range=0..999 step 1)  # graph input

# group: 회전 Seed
seed_회전용 = DoubleSlider(578, range=0..999 step 1)  # graph input

# group: Floor Level
code_block_2 = CodeBlock { [-6000, 0, 6000, 12000]; }

code_block_3 = CodeBlock(FixedPartSeed=seed_고정부_코어, NonFixedPartSeed=seed_변형부_공간, RotatingSeed=seed_회전용, FloorLevel=code_block_2)
# ---------- code_block_3.designscript (6 lines) ----------
{
"FixedPartSeed": _FixedPartSeed,
"NonFixedPartSeed": _NonFixedPartSeed,
"RotatingSeed": _RotatingSeed,
"FloorLevel": _FloorLevel
};
# ----------------------------------------
extendsChildDictionaryFromParent = Custom[ExtendsChildDictionaryFromParent](ParentDic=code_block, ChildDic=code_block_3)  # Extends Child Dictionary From Parent

# group: Excel Data import (package 정리 전)
file_path = Filename("상상진화\20210824\space planning test 0802mk 001.xlsx")
file_from_path = FileObject(path=file_path)
string_from_object = FromObject(object=file_from_path)
code_block_4 = CodeBlock { "Sheet1"; "SampleBuildingProgram-Clinic"; false; }
python_script_import_excel_by = Python(IN[0]=string_from_object, IN[1]=code_block_4.out0)  # "Python Script@Import Excel(By OpenpyXl)"; CPython3
# ---------- python_script_import_excel_by.python (50 lines) ----------
# Load the Python Standard and DesignScript Libraries
import sys
import os
#sys.path.append(r'C:\Users\HEC\AppData\Local\Programs\Python\Python39\Lib\site-packages')
#sys.path.append(r'C:\Users\pjmk0\AppData\Local\Programs\Python\Python39\Lib\site-packages')
sys.path.append(os.getenv('LOCALAPPDATA').replace('\\','\\\\') + r'\Programs\Python\Python39\Lib\site-packages')
import clr
clr.AddReference('ProtoGeometry')
from Autodesk.DesignScript.Geometry import *
from collections import Iterable

def iterable(obj):
    return isinstance(obj, Iterable)


# The inputs to this node will be stored as a list in the IN variables.
dataEnteringNode = IN
PathIn = IN[0]
SheetNameIn = IN[1]

# Place your code below this line
import datetime
import openpyxl

path = (PathIn)
#path = (r'C:\Users\pjmk0\Downloads\MK\mQ\BIM_물량집계 자동화 산출기준표_rC(20210607)_mk_de.xlsx')

wb_obj = openpyxl.load_workbook(path, data_only=True)
sheet_obj = wb_obj.get_sheet_by_name(SheetNameIn)

m_row = sheet_obj.max_row
m_col = sheet_obj.max_column

listOut = []



for i in range(1, m_row +1):
    listTemp = []
    for j in range(1, m_col + 1):
        cell_obj = sheet_obj.cell(row=i, column=j)
        listTemp.append(cell_obj.value)
        if len(listTemp) == m_col:
            listOut.append(listTemp)
        


# Assign your output to the OUT variable.
OUT = listOut
#OUT = os.getenv('APPDATA')
# ----------------------------------------
excel_data_정리_전 = Watch(python_script_import_excel_by)

remember_2 = Data.Remember(excel_data_정리_전)

# group: Excel List 분할
excel_data_정리_전_2 = Watch(remember_2)
transpose = List.Transpose(lists=excel_data_정리_전_2)
code_block_5 = CodeBlock { 1; }
# note: List Name 정리
dropItems = List.DropItems(list=transpose@L2, amount=code_block_5)
watch = Watch(dropItems)
code_block_6 = CodeBlock { 0; }
getItemAtIndex = List.GetItemAtIndex(list=watch, index=code_block_6)
space_id = Watch(getItemAtIndex)
code_block_7 = CodeBlock { 1; }
getItemAtIndex_2 = List.GetItemAtIndex(list=watch, index=code_block_7)
space_name = Watch(getItemAtIndex_2)
code_block_8 = CodeBlock { 10; }
getItemAtIndex_3 = List.GetItemAtIndex(list=watch, index=code_block_8)
adjacent_spaces = Watch(getItemAtIndex_3)
code_block_9 = CodeBlock { 3; }
getItemAtIndex_4 = List.GetItemAtIndex(list=watch, index=code_block_9)
department_id = Watch(getItemAtIndex_4)
code_block_10 = CodeBlock { 2; }
getItemAtIndex_5 = List.GetItemAtIndex(list=watch, index=code_block_10)
DEPARTMENT = Watch(getItemAtIndex_5)
code_block_11 = CodeBlock { 11; }
getItemAtIndex_6 = List.GetItemAtIndex(list=watch, index=code_block_11)
lev = Watch(getItemAtIndex_6)
code_block_12 = CodeBlock { 5; }
getItemAtIndex_7 = List.GetItemAtIndex(list=watch, index=code_block_12)
WIDTH = Watch(getItemAtIndex_7)
code_block_13 = CodeBlock { 6; }
getItemAtIndex_8 = List.GetItemAtIndex(list=watch, index=code_block_13)
length = Watch(getItemAtIndex_8)
code_block_14 = CodeBlock { 7; }
getItemAtIndex_9 = List.GetItemAtIndex(list=watch, index=code_block_14)
height = Watch(getItemAtIndex_9)
code_block_15 = CodeBlock { 8; }
getItemAtIndex_10 = List.GetItemAtIndex(list=watch, index=code_block_15)
AREA = Watch(getItemAtIndex_10)
code_block_16 = CodeBlock { 14; }
getItemAtIndex_11 = List.GetItemAtIndex(list=watch, index=code_block_16)
ROTATE = Watch(getItemAtIndex_11)
code_block_17 = CodeBlock { 15; }
getItemAtIndex_12 = List.GetItemAtIndex(list=watch, index=code_block_17)
CLUSTER = Watch(getItemAtIndex_12)
code_block_18 = CodeBlock(ExcelDataWithNoHead=watch, SpaceID=space_id, SpaceName=space_name, AdjacentSpaces=adjacent_spaces, DepartmentID=department_id, Department=DEPARTMENT, Level=lev, Width=WIDTH, Length=length, Height=height, Area=AREA, Rotate=ROTATE, Cluster=CLUSTER)
# ---------- code_block_18.designscript (15 lines) ----------
{
"ExcelDataWithNoHead": _ExcelDataWithNoHead,
"SpaceID": _SpaceID,
"SpaceName": _SpaceName,
"AdjacentSpaces": _AdjacentSpaces,
"DepartmentID": _DepartmentID,
"Department": _Department,
"Level": _Level,
"Width": _Width,
"Length": _Length,
"Height": _Height,
"Area": _Area,
"Rotate": _Rotate,
"Cluster": _Cluster
};
# ----------------------------------------

code_block_19 = CodeBlock(InputDic=code_block_18) { _InputDic; }
code_block_20 = CodeBlock { "SpaceID"; }
valueAtKey = DesignScript.Builtin.Dictionary.ValueAtKey(dictionary=code_block_19, key=code_block_20)
code_block_21 = CodeBlock { "SpaceName"; }
valueAtKey_2 = DesignScript.Builtin.Dictionary.ValueAtKey(dictionary=code_block_19, key=code_block_21)
code_block_22 = CodeBlock { "AdjacentSpaces"; }
valueAtKey_3 = DesignScript.Builtin.Dictionary.ValueAtKey(dictionary=code_block_19, key=code_block_22)
code_block_23 = CodeBlock { "DepartmentID"; }
valueAtKey_4 = DesignScript.Builtin.Dictionary.ValueAtKey(dictionary=code_block_19, key=code_block_23)
code_block_24 = CodeBlock { "Department"; }
valueAtKey_5 = DesignScript.Builtin.Dictionary.ValueAtKey(dictionary=code_block_19, key=code_block_24)
code_block_25 = CodeBlock { "Level"; }
valueAtKey_6 = DesignScript.Builtin.Dictionary.ValueAtKey(dictionary=code_block_19, key=code_block_25)
code_block_26 = CodeBlock { "Width"; }
valueAtKey_7 = DesignScript.Builtin.Dictionary.ValueAtKey(dictionary=code_block_19, key=code_block_26)
code_block_27 = CodeBlock { "Length"; }
valueAtKey_8 = DesignScript.Builtin.Dictionary.ValueAtKey(dictionary=code_block_19, key=code_block_27)
code_block_28 = CodeBlock { "Height"; }
valueAtKey_9 = DesignScript.Builtin.Dictionary.ValueAtKey(dictionary=code_block_19, key=code_block_28)
code_block_29 = CodeBlock { "Area"; }
valueAtKey_10 = DesignScript.Builtin.Dictionary.ValueAtKey(dictionary=code_block_19, key=code_block_29)
code_block_30 = CodeBlock { "Rotate"; }
valueAtKey_11 = DesignScript.Builtin.Dictionary.ValueAtKey(dictionary=code_block_19, key=code_block_30)
code_block_31 = CodeBlock { "Cluster"; }
valueAtKey_12 = DesignScript.Builtin.Dictionary.ValueAtKey(dictionary=code_block_19, key=code_block_31)
code_block_32 = CodeBlock(BoxSpaceID=valueAtKey, BoxSpaceName=valueAtKey_2, BoxAdjacentSpaces=valueAtKey_3, BoxDepartmentID=valueAtKey_4, BoxDepartment=valueAtKey_5, BoxLevel=valueAtKey_6, BoxWidth=valueAtKey_7, BoxLength=valueAtKey_8, BoxHeight=valueAtKey_9, BoxArea=valueAtKey_10, BoxRotate=valueAtKey_11, BoxCluster=valueAtKey_12)
# ---------- code_block_32.designscript (15 lines) ----------
///Box Class Primary
{
"BoxSpaceID": _BoxSpaceID,
"BoxSpaceName": _BoxSpaceName,
"BoxAdjacentSpaces": _BoxAdjacentSpaces,
"BoxDepartmentID": _BoxDepartmentID,
"BoxDepartment": _BoxDepartment,
"BoxLevel": _BoxLevel,
"BoxWidth": _BoxWidth,
"BoxLength": _BoxLength,
"BoxHeight": _BoxHeight,
"BoxArea": _BoxArea,
"BoxRotate": _BoxRotate,
"BoxCluster": _BoxCluster
};
# ----------------------------------------
code_block_33 = CodeBlock(BoxClass_Primary=code_block_32)
# ---------- code_block_33.designscript (3 lines) ----------
{
"BoxClass_Primary": _BoxClass_Primary
};
# ----------------------------------------
extendsChildDictionaryFromParent_2 = Custom[ExtendsChildDictionaryFromParent](ParentDic=extendsChildDictionaryFromParent.dictionary, ChildDic=code_block_33)
setBoxZvalueProp = Custom[SetBoxZvalueProp](InputDic=extendsChildDictionaryFromParent_2.dictionary)  # SetBoxZvalueProp
createGridPointOfBldgBoundary = Custom[CreateGridPointOfBldgBoundary](InputDic=setBoxZvalueProp)  # CreateGridPointOfBldgBoundary
distributeRandomSeedForFixedPart = Custom[DistributeRandomSeedForFixedPart](InputDic=createGridPointOfBldgBoundary)  # DistributeRandomSeedForFixedPart
placeFixedPartBoxBySeed = Custom[PlaceFixedPartBoxBySeed](InputDic=distributeRandomSeedForFixedPart)  # PlaceFixedPartBoxBySeed
code_block_34 = CodeBlock { "BoxClass_fixedpart"; }
valueAtKey_13 = DesignScript.Builtin.Dictionary.ValueAtKey(dictionary=placeFixedPartBoxBySeed, key=code_block_34)
code_block_35 = CodeBlock { "BoxGeometry"; }
valueAtKey_14 = DesignScript.Builtin.Dictionary.ValueAtKey(dictionary=valueAtKey_13, key=code_block_35)
color_palette = ColorPalette({R: 255, G: 20, B: 147, A: 255})
byGeometryColor = Modifiers.GeometryColor.ByGeometryColor(geometry=valueAtKey_14, color=color_palette)
extractUnoccupiedGridPointsByLevel = Custom[ExtractUnoccupiedGridPointsByLevel](InputDic=placeFixedPartBoxBySeed)  # ExtractUnoccupiedGridPointsByLevel
findNonFixedPartBox = Custom[FindNonFixedPartBox](InputDic=extractUnoccupiedGridPointsByLevel)  # FindNonFixedPartBox
distributeRandomSeedForNonFixedPart = Custom[DistributeRandomSeedForNonFixedPart](InputDic=findNonFixedPartBox)  # DistributeRandomSeedForNonFixedPart
placeNonFixedPartBoxBySeed = Custom[PlaceNonFixedPartBoxBySeed](InputDic=distributeRandomSeedForNonFixedPart)  # PlaceNonFixedPartBoxBySeed
code_block_36 = CodeBlock { "BoxClass_nonfixedpart"; }
valueAtKey_15 = DesignScript.Builtin.Dictionary.ValueAtKey(dictionary=placeNonFixedPartBoxBySeed, key=code_block_36)
code_block_37 = CodeBlock { "BoxGeometry"; }
valueAtKey_16 = DesignScript.Builtin.Dictionary.ValueAtKey(dictionary=valueAtKey_15, key=code_block_37)
color_palette_2 = ColorPalette({R: 0, G: 255, B: 255, A: 120})
byGeometryColor_2 = Modifiers.GeometryColor.ByGeometryColor(geometry=valueAtKey_16, color=color_palette_2)

# group: REC (사각형) 변경 전
code_block_38 = CodeBlock { _InputDic; }  # frozen; unwired: InputDic
code_block_39 = CodeBlock { "AreaPerDepartment"; }
valueAtKey_17 = DesignScript.Builtin.Dictionary.ValueAtKey(dictionary=code_block_38, key=code_block_39)
code_block_40 = CodeBlock { "RoomCenterPointPerDepartment"; }
valueAtKey_18 = DesignScript.Builtin.Dictionary.ValueAtKey(dictionary=code_block_38, key=code_block_40)

code_block_41 = CodeBlock { "Length"; "Width"; }
valueAtKey_19 = DesignScript.Builtin.Dictionary.ValueAtKey(dictionary=code_block_38, key=code_block_41.out0)
code_block_42 = CodeBlock { "SpaceIDPerDepartment"; }
valueAtKey_20 = DesignScript.Builtin.Dictionary.ValueAtKey(dictionary=code_block_38, key=code_block_42)
flatten_2 = List.Flatten(list=valueAtKey_20)
getItemAtIndex_13 = List.GetItemAtIndex(list=valueAtKey_19, index=flatten_2)
valueAtKey_21 = DesignScript.Builtin.Dictionary.ValueAtKey(dictionary=code_block_38, key=code_block_41.out1)
getItemAtIndex_14 = List.GetItemAtIndex(list=valueAtKey_21, index=flatten_2)

# group (continued): REC (사각형) 변경 전
byWidthLength = Rectangle.ByWidthLength(width=getItemAtIndex_13, length=getItemAtIndex_14)

flatten_3 = List.Flatten(list=valueAtKey_18)

# group (continued): REC (사각형) 변경 전
X = Point.X(point=flatten_3)

flatten_4 = List.Flatten(list=valueAtKey_18)

# group (continued): REC (사각형) 변경 전
Y = Point.Y(point=flatten_4)

flatten_5 = List.Flatten(list=valueAtKey_18)

# group (continued): REC (사각형) 변경 전
Z = Point.Z(point=flatten_5)
translate = Geometry.Translate(geometry=byWidthLength, xTranslation=X, yTranslation=Y, zTranslation=Z)
byPatch = Surface.ByPatch(closedCurve=translate)
code_block_43 = CodeBlock(RoomRectangle=translate, RoomRectangleZvalue=Z, RoomRectangleSurface=byPatch)
# ---------- code_block_43.designscript (5 lines) ----------
{
"RoomRectangle": _RoomRectangle,
"RoomRectangleZvalue": _RoomRectangleZvalue,
"RoomRectangleSurface": _RoomRectangleSurface
};
# ----------------------------------------
extendsChildDictionaryFromParent_3 = Custom[ExtendsChildDictionaryFromParent](ParentDic=code_block_38, ChildDic=code_block_43)

# group: 부서별 색상 지정
code_block_44 = CodeBlock(InputDic=extendsChildDictionaryFromParent_3.dictionary) { _InputDic; }
code_block_45 = CodeBlock { "Department"; }
valueAtKey_22 = DesignScript.Builtin.Dictionary.ValueAtKey(dictionary=code_block_44, key=code_block_45)
watch_2 = Watch(valueAtKey_22)
uniqueItems = List.UniqueItems(list=watch_2)
code_block_46 = CodeBlock()
# ---------- code_block_46.designscript (6 lines) ----------
color1 = Color.ByARGB(200, 100, 0, 200);
color2 = Color.ByARGB(200, 0, 0, 0);
color3 = Color.ByARGB(200, 200, 0, 0);
color4 = Color.ByARGB(200, 0, 0, 200);
color5 = Color.ByARGB(200, 200, 0, 100);
color6 = Color.ByARGB(200, 0, 200, 0);
# ----------------------------------------
remember_3 = Data.Remember(code_block_46.color1)
remember_4 = Data.Remember(code_block_46.color2)
remember_5 = Data.Remember(code_block_46.color3)
remember_6 = Data.Remember(code_block_46.color4)
remember_7 = Data.Remember(code_block_46.color5)
remember_8 = Data.Remember(code_block_46.color6)
join = List.Join(list0=remember_3, list1=remember_4, list2=remember_5, list3=remember_6, list4=remember_7, list5=remember_8)
byKeysValues = DesignScript.Builtin.Dictionary.ByKeysValues(keys=uniqueItems, values=join)
code_block_47 = CodeBlock(DepartmentColorDic=byKeysValues)
# ---------- code_block_47.designscript (3 lines) ----------
{
"DepartmentColorDic": _DepartmentColorDic
};
# ----------------------------------------
extendsChildDictionaryFromParent_4 = Custom[ExtendsChildDictionaryFromParent](ParentDic=code_block_44, ChildDic=code_block_47)

# group: 사각 공간 색상 지정
code_block_48 = CodeBlock(InputDic=extendsChildDictionaryFromParent_4.dictionary) { _InputDic; }
code_block_49 = CodeBlock { "RoomRectangleSurface"; }
valueAtKey_23 = DesignScript.Builtin.Dictionary.ValueAtKey(dictionary=code_block_48, key=code_block_49)
code_block_50 = CodeBlock { "BoxHeight"; }
valueAtKey_24 = DesignScript.Builtin.Dictionary.ValueAtKey(dictionary=code_block_48, key=code_block_50)
boolean = BoolSelector(false)
thicken = Surface.Thicken(surface=valueAtKey_23, thickness=valueAtKey_24, both_sides=boolean)
code_block_51 = CodeBlock { "DepartmentColorDic"; }
valueAtKey_25 = DesignScript.Builtin.Dictionary.ValueAtKey(dictionary=code_block_48, key=code_block_51)
code_block_52 = CodeBlock { "Department"; }
valueAtKey_26 = DesignScript.Builtin.Dictionary.ValueAtKey(dictionary=code_block_48, key=code_block_52)
code_block_53 = CodeBlock { "SpaceIDPerDepartment"; }
valueAtKey_27 = DesignScript.Builtin.Dictionary.ValueAtKey(dictionary=code_block_48, key=code_block_53)
flatten_6 = List.Flatten(list=valueAtKey_27)
getItemAtIndex_15 = List.GetItemAtIndex(list=valueAtKey_26, index=flatten_6)
valueAtKey_28 = DesignScript.Builtin.Dictionary.ValueAtKey(dictionary=valueAtKey_25, key=getItemAtIndex_15)
byGeometryColor_3 = Modifiers.GeometryColor.ByGeometryColor(geometry=thicken, color=valueAtKey_28)
code_block_54 = CodeBlock(RoomSolid=thicken)
# ---------- code_block_54.designscript (3 lines) ----------
{
"RoomSolid": _RoomSolid
};
# ----------------------------------------
extendsChildDictionaryFromParent_5 = Custom[ExtendsChildDictionaryFromParent](ParentDic=code_block_48, ChildDic=code_block_54)

# group: GD Output - difference area to minimum
code_block_55 = CodeBlock(InputDic=extendsChildDictionaryFromParent_5.dictionary) { _InputDic; }
code_block_56 = CodeBlock { "RoomRectangle"; }
valueAtKey_29 = DesignScript.Builtin.Dictionary.ValueAtKey(dictionary=code_block_55, key=code_block_56)
flatten_7 = List.Flatten(list=valueAtKey_29)
code_block_57 = CodeBlock { "RoomRectangleZvalue"; }
valueAtKey_30 = DesignScript.Builtin.Dictionary.ValueAtKey(dictionary=code_block_55, key=code_block_57)
flatten_8 = List.Flatten(list=valueAtKey_30)
uniqueItems_2 = List.UniqueItems(list=flatten_8)
allIndicesOf = List.AllIndicesOf(list=flatten_8, item=uniqueItems_2)
code_block_58 = CodeBlock { "RoomBoundary"; }
valueAtKey_31 = DesignScript.Builtin.Dictionary.ValueAtKey(dictionary=code_block_55, key=code_block_58)
basePlane = PolyCurve.BasePlane(polyCurve=valueAtKey_31)
firstItem_2 = List.FirstItem(list=basePlane)
code_block_59 = CodeBlock { 1; }
code_block_60 = CodeBlock { 10; }
offset = Curve.Offset(curve=valueAtKey_31, distance=code_block_60)

flatten_9 = List.Flatten(list=allIndicesOf)

# group (continued): GD Output - difference area to minimum
getItemAtIndex_16 = List.GetItemAtIndex(list=flatten_7, index=flatten_9)
pullOntoPlane = Curve.PullOntoPlane(curve=getItemAtIndex_16, plane=firstItem_2)
byPatch_2 = Surface.ByPatch(closedCurve=pullOntoPlane)
split = Geometry.Split(geometry=byPatch_2, other=valueAtKey_31, lacing=CrossProduct)
flatten_10 = List.Flatten(list=split@L2, amt=code_block_59)
flatten_11 = List.Flatten(list=flatten_10)
doesIntersect = Geometry.DoesIntersect(geometry=flatten_11@L2, other=offset@L1)
flatten_12 = List.Flatten(list=doesIntersect)
filterByBoolMask = List.FilterByBoolMask(list=flatten_11, mask=flatten_12)
area = Surface.Area(surface=filterByBoolMask.in)
math_sum_outside_area_of = Math.Sum(values=area)  # "Math.Sum@Outside Area of Boundary"; graph output

# group: BoxClass_Secondary 생성(fixed + nonfixed) 및 BoxCenterpoint 속성 추가
code_block_61 = CodeBlock(InputDic=placeNonFixedPartBoxBySeed) { _InputDic; }
code_block_62 = CodeBlock { "BoxCenterPoint"; }
code_block_63 = CodeBlock { "BoxClass_fixedpart"; }
valueAtKey_32 = DesignScript.Builtin.Dictionary.ValueAtKey(dictionary=code_block_61, key=code_block_63)
components = DesignScript.Builtin.Dictionary.Components(dictionary=valueAtKey_32)
transpose_2 = List.Transpose(lists=components.values)
code_block_64 = CodeBlock { "BoxClass_nonfixedpart"; }
valueAtKey_33 = DesignScript.Builtin.Dictionary.ValueAtKey(dictionary=code_block_61, key=code_block_64)
components_2 = DesignScript.Builtin.Dictionary.Components(dictionary=valueAtKey_33)
transpose_3 = List.Transpose(lists=components_2.values)
join_2 = List.Join(list0=transpose_2, list1=transpose_3)
code_block_65 = CodeBlock { 5; }
list_getitematindex_getspaceid = List.GetItemAtIndex(list=join_2@L2, index=code_block_65)
sort = List.Sort(list=list_getitematindex_getspaceid)
allIndicesOf_2 = List.AllIndicesOf(list=list_getitematindex_getspaceid, item=sort)
flatten_13 = List.Flatten(list=allIndicesOf_2)
list_getitematindex = List.GetItemAtIndex(list=join_2, index=flatten_13)  # "List.GetItemAtIndex@SortBySpaceID"
transpose_4 = List.Transpose(lists=list_getitematindex)
byKeysValues_2 = DesignScript.Builtin.Dictionary.ByKeysValues(keys=components.keys, values=transpose_4)
components_3 = DesignScript.Builtin.Dictionary.Components(dictionary=byKeysValues_2)
addItemToEnd = List.AddItemToEnd(item=code_block_62, list=components_3.keys)
code_block_66 = CodeBlock { "BoxGeometry"; }
valueAtKey_34 = DesignScript.Builtin.Dictionary.ValueAtKey(dictionary=byKeysValues_2, key=code_block_66)
centroid = Solid.Centroid(solid=valueAtKey_34)
addItemToEnd_2 = List.AddItemToEnd(item=centroid, list=components_3.values)
byKeysValues_3 = DesignScript.Builtin.Dictionary.ByKeysValues(keys=addItemToEnd, values=addItemToEnd_2)
code_block_67 = CodeBlock(BoxClass_Secondary=byKeysValues_3)
# ---------- code_block_67.designscript (3 lines) ----------
{
"BoxClass_Secondary": _BoxClass_Secondary
};
# ----------------------------------------
extendsChildDictionaryFromParent_6 = Custom[ExtendsChildDictionaryFromParent](ParentDic=code_block_61, ChildDic=code_block_67)
