# Dynamo graph 2-3_Room Generating(0701).dyn (Dynamo 2.10.1.3976)

categories = Categories("OST_Rooms")
all_elements_of_category = ElementsOfCategory(Category=categories)
watch = Watch(all_elements_of_category)
flatten = List.Flatten(list=watch)
watch_2 = Watch(flatten)
all_elements_in_active_view = ElementsInView()
watch_3 = Watch(all_elements_in_active_view)
name = Element.Name(element=watch_3)
code_block = CodeBlock { "Room"; "Space Planning Box"; }
contains = String.Contains(str=name, searchFor=code_block.out1)
filterByBoolMask = List.FilterByBoolMask(list=watch_3, mask=contains)
watch_4 = Watch(filterByBoolMask.in)
geometry = Element.Geometry(element=flatten)
centroid = Solid.Centroid(solid=geometry)
flatten_2 = List.Flatten(list=centroid)
geometry_2 = Element.Geometry(element=watch_4)
flatten_3 = List.Flatten(list=geometry_2)
doesIntersect = Geometry.DoesIntersect(geometry=flatten_2, other=flatten_3, lacing=CrossProduct)
watch_5 = Watch(doesIntersect)
filterByBoolMask_2 = List.FilterByBoolMask(list=watch_4, mask=watch_5@L2)
watch_6 = Watch(filterByBoolMask_2.in)
count = List.Count(list=watch_6@L2)
watch_7 = Watch(count)
code_block_2 = CodeBlock(a=watch_7) { a>1; }
watch_8 = Watch(code_block_2)
filterByBoolMask_3 = List.FilterByBoolMask(list=filterByBoolMask_2.in, mask=watch_8)
watch_9 = Watch(filterByBoolMask_3.out)
geometry_3 = Element.Geometry(element=watch_9)
flatten_4 = List.Flatten(list=geometry_3)
geometry_4 = Element.Geometry(element=watch_2)
centroid_2 = Solid.Centroid(solid=geometry_4)
flatten_5 = List.Flatten(list=centroid_2)
doesIntersect_2 = Geometry.DoesIntersect(geometry=flatten_4, other=flatten_5, lacing=CrossProduct)
filterByBoolMask_4 = List.FilterByBoolMask(list=watch_2, mask=doesIntersect_2@L2)
watch_10 = Watch(filterByBoolMask_4.in)
area = Room.Area()  # unwired: room
maximumItemByKey = List.MaximumItemByKey(list=watch_10@L2, keyFunction=area)
watch_11 = Watch(maximumItemByKey)
code_block_3 = CodeBlock { "Name"; }
flatten_6 = List.Flatten(list=watch_9)
watch_12 = Watch(flatten_6)
code_block_4 = CodeBlock { "Room Name"; }
getParameterValueByName = Element.GetParameterValueByName(element=watch_12, parameterName=code_block_4)
watch_13 = Watch(getParameterValueByName)
setParameterByName = Element.SetParameterByName(element=watch_11, parameterName=code_block_3, value=watch_13)
watch_14 = Watch(filterByBoolMask_3.in)
flatten_7 = List.Flatten(list=watch_14)
uniqueItems = List.UniqueItems(list=flatten_7)

# group: 3개 겹침
code_block_5 = CodeBlock {  }
code_block_6 = CodeBlock {  }

watch_15 = Watch(watch_2)
count_2 = List.Count(list=watch_14@L2)
code_block_7 = CodeBlock { 3; }
eq = count_2 == code_block_7
filterByBoolMask_5 = List.FilterByBoolMask(list=watch_14, mask=eq)
watch_16 = Watch(filterByBoolMask_5.in)
flatten_8 = List.Flatten(list=watch_16)
code_block_8 = CodeBlock { "Area"; }
getParameterValueByName_2 = Element.GetParameterValueByName(parameterName=code_block_8)  # unwired: element
maximumItemByKey_2 = List.MaximumItemByKey(list=flatten_8, keyFunction=getParameterValueByName_2)
geometry_5 = Element.Geometry(element=maximumItemByKey_2)
watch_17 = Watch(flatten_2)
doesIntersect_3 = Geometry.DoesIntersect(geometry=geometry_5, other=watch_17, lacing=Longest)
filterByBoolMask_6 = List.FilterByBoolMask(list=watch_15, mask=doesIntersect_3)
watch_18 = Watch(filterByBoolMask_6.in)
code_block_9 = CodeBlock { "Area"; }
getParameterValueByName_3 = Element.GetParameterValueByName(parameterName=code_block_9)  # unwired: element
sortByKey = List.SortByKey(list=watch_18@L1, keys=getParameterValueByName_3)
watch_19 = Watch(sortByKey.sortedList)
flatten_9 = List.Flatten(list=watch_19)
code_block_10 = CodeBlock { "Name"; }
code_block_11 = CodeBlock { "Area"; }
getParameterValueByName_4 = Element.GetParameterValueByName(parameterName=code_block_11)  # unwired: element
sortByKey_2 = List.SortByKey(list=flatten_8@L1, keys=getParameterValueByName_4)
watch_20 = Watch(sortByKey_2.sortedList)
flatten_10 = List.Flatten(list=watch_20)
code_block_12 = CodeBlock { "Room Name"; }
getParameterValueByName_5 = Element.GetParameterValueByName(element=flatten_10, parameterName=code_block_12)
watch_21 = Watch(getParameterValueByName_5)
setParameterByName_2 = Element.SetParameterByName(element=flatten_9, parameterName=code_block_10, value=watch_21)

# group: 1:1 겹침 없음
code_block_13 = CodeBlock {  }
code_block_14 = CodeBlock {  }

# group: 2개 겹침
code_block_15 = CodeBlock {  }
code_block_16 = CodeBlock {  }

count_3 = List.Count(list=watch_10@L2)
watch_22 = Watch(count_3)
code_block_17 = CodeBlock(a=watch_22) { a==2; }
watch_23 = Watch(code_block_17)
filterByBoolMask_7 = List.FilterByBoolMask(list=watch_10, mask=watch_23)
watch_24 = Watch(filterByBoolMask_7.in)
flatten_11 = List.Flatten(list=watch_24)
watch_25 = Watch(flatten_11)
code_block_18 = CodeBlock { "Name"; }
watch_26 = Watch(filterByBoolMask_3.in)
flatten_12 = List.Flatten(list=watch_26)
geometry_6 = Element.Geometry(element=watch_24)
centroid_3 = Solid.Centroid(solid=geometry_6)
flatten_13 = List.Flatten(list=centroid_3)
geometry_7 = Element.Geometry(element=flatten_12)
flatten_14 = List.Flatten(list=geometry_7)
doesIntersect_4 = Geometry.DoesIntersect(geometry=flatten_13, other=flatten_14, lacing=CrossProduct)
watch_27 = Watch(doesIntersect_4)
filterByBoolMask_8 = List.FilterByBoolMask(list=flatten_12, mask=watch_27@L2)
watch_28 = Watch(filterByBoolMask_8.in)
code_block_19 = CodeBlock { "Area"; }
getParameterValueByName_6 = Element.GetParameterValueByName(parameterName=code_block_19)  # unwired: element
minimumItemByKey = List.MinimumItemByKey(list=watch_28@L2, keyFunction=getParameterValueByName_6)
watch_29 = Watch(minimumItemByKey)
code_block_20 = CodeBlock { "Room Name"; }
getParameterValueByName_7 = Element.GetParameterValueByName(element=watch_29, parameterName=code_block_20)
watch_30 = Watch(getParameterValueByName_7)
setParameterByName_3 = Element.SetParameterByName(element=watch_25, parameterName=code_block_18, value=watch_30)
code_block_21 = CodeBlock { 100; }
byARGB = Color.ByARGB(a=code_block_21, r=code_block_21)
byGeometryColor = Modifiers.GeometryColor.ByGeometryColor(geometry=geometry, color=byARGB)

# group: 4개 겹침
code_block_22 = CodeBlock {  }
code_block_23 = CodeBlock {  }

watch_31 = Watch(filterByBoolMask_3.in)
flatten_15 = List.Flatten(list=watch_31)
uniqueItems_2 = List.UniqueItems(list=flatten_15)
watch_32 = Watch(watch_2)
count_4 = List.Count(list=watch_31@L2)
code_block_24 = CodeBlock { 4; }
eq_2 = count_4 == code_block_24
filterByBoolMask_9 = List.FilterByBoolMask(list=watch_31, mask=eq_2)
watch_33 = Watch(filterByBoolMask_9.in)
flatten_16 = List.Flatten(list=watch_33)
code_block_25 = CodeBlock { "Area"; }
getParameterValueByName_8 = Element.GetParameterValueByName(parameterName=code_block_25)  # unwired: element
maximumItemByKey_3 = List.MaximumItemByKey(list=flatten_16, keyFunction=getParameterValueByName_8)
geometry_8 = Element.Geometry(element=maximumItemByKey_3)
watch_34 = Watch(flatten_2)
doesIntersect_5 = Geometry.DoesIntersect(geometry=geometry_8, other=watch_34, lacing=Longest)
filterByBoolMask_10 = List.FilterByBoolMask(list=watch_32, mask=doesIntersect_5)
watch_35 = Watch(filterByBoolMask_10.in)
code_block_26 = CodeBlock { "Area"; }
getParameterValueByName_9 = Element.GetParameterValueByName(parameterName=code_block_26)  # unwired: element
sortByKey_3 = List.SortByKey(list=watch_35@L1, keys=getParameterValueByName_9)
watch_36 = Watch(sortByKey_3.sortedList)
flatten_17 = List.Flatten(list=watch_36)
code_block_27 = CodeBlock { "Name"; }
code_block_28 = CodeBlock { "Area"; }
getParameterValueByName_10 = Element.GetParameterValueByName(parameterName=code_block_28)  # unwired: element
sortByKey_4 = List.SortByKey(list=flatten_16@L1, keys=getParameterValueByName_10)
watch_37 = Watch(sortByKey_4.sortedList)
flatten_18 = List.Flatten(list=watch_37)
code_block_29 = CodeBlock { "Room Name"; }
getParameterValueByName_11 = Element.GetParameterValueByName(element=flatten_18, parameterName=code_block_29)
watch_38 = Watch(getParameterValueByName_11)
setParameterByName_4 = Element.SetParameterByName(element=flatten_17, parameterName=code_block_27, value=watch_38)
