# Dynamo graph 4_.dyn (Dynamo 2.10.1.3976)

code_block = CodeBlock()
# ---------- code_block.designscript (4 lines) ----------
{
"a": 1,
"b": 2
};
# ----------------------------------------
code_block_2 = CodeBlock(a=code_block) { a; b = a["b"]; }
categories = Categories("OST_Rooms")
all_elements_of_category = ElementsOfCategory(Category=categories)
parameters = Element.Parameters(element=all_elements_of_category)
file_path = Filename(".\test1.xslx")
code_block_3 = CodeBlock { "Sheet1"; }
code_block_4 = CodeBlock { 0; }
addItemToFront = List.AddItemToFront()  # unwired: item, list
code_block_5 = CodeBlock()
# ---------- code_block_5.designscript (7 lines) ----------
[
"A",
"B",
"C",
"D",
"E"
];
# ----------------------------------------
name = Element.Name(element=all_elements_of_category)
code_block_6 = CodeBlock { "Department"; }
getParameterValueByName = Element.GetParameterValueByName(element=all_elements_of_category, parameterName=code_block_6)
code_block_7 = CodeBlock { "Interior Finish"; }
getParameterValueByName_2 = Element.GetParameterValueByName(element=all_elements_of_category, parameterName=code_block_7)
code_block_8 = CodeBlock { "Exterior Finish"; }
getParameterValueByName_3 = Element.GetParameterValueByName(element=all_elements_of_category, parameterName=code_block_8)
code_block_9 = CodeBlock { "Area"; }
getParameterValueByName_4 = Element.GetParameterValueByName(element=all_elements_of_category, parameterName=code_block_9)
code_block_10 = CodeBlock { "Perimeter"; }
getParameterValueByName_5 = Element.GetParameterValueByName(element=all_elements_of_category, parameterName=code_block_10)
code_block_11 = CodeBlock(t1=getParameterValueByName_5) { num2 = Math.Round(t1, 1)/1000; }
list_create = List.Create(item0=name, item1=getParameterValueByName, item2=getParameterValueByName_2, item3=getParameterValueByName_3, item4=getParameterValueByName_4, item5=code_block_11)
transpose = List.Transpose(lists=list_create)
watch = Watch(transpose)
cartesianProduct = List.CartesianProduct(combineFunction=addItemToFront, list0=code_block_5, list1=watch)
code_block_12 = CodeBlock { 1; }
flatten = List.Flatten(list=cartesianProduct, amt=code_block_12)
code_block_13 = CodeBlock { true; }
exportExcel = Data.ExportExcel(filePath=file_path, sheetName=code_block_3, startRow=code_block_4, startCol=code_block_4, data=flatten, overWrite=code_block_13)  # frozen
interior_finish_floor = CodeBlock()
# ---------- interior_finish_floor.designscript (8 lines) ----------
[
["A04AL080-00006...Epoxy paint"],
["A04AM083-00004...Vinyl Tile"],
["A04AM083-00004...Vinyl Tile"],
["A04AM083-00005...Anti-Static Vinyl Tile"],
["A04AL080-00003...Acid/Alkaline Resistant Paint"],
["A04AM083-00001...Ceramic Tile", "A04AN000-00001...Waterproofing Membrane"]
];
# ----------------------------------------
code_block_14 = CodeBlock { "..."; }
interior_finish_wall = CodeBlock()
# ---------- interior_finish_wall.designscript (11 lines) ----------
[
["A04AL078-00003...Latex Paint"],
["A04AL078-00003...Latex Paint"],
["A04AL078-00003...Latex Paint"],
["A04AL078-00003...Latex Paint"],
["A04AL078-00004...Acid/Alkaline Resistant Paint, H=1.5",
"A04AL078-00003...Latex Paint"],
["A04AM082-00002...Glazed Ceramic Tile, H=1.8",
"A04AN000-00001...Waterproofing Membrane, H=1.8m",
"A04AL078-00003...Latex Paint"]
];
# ----------------------------------------
interior_finish_skirt = CodeBlock()
# ---------- interior_finish_skirt.designscript (8 lines) ----------
[
["A04AR151-00001...Coved Rubber Skirting, H=100"],
["A04AR151-00001...Coved Rubber Skirting, H=100"],
["A04AR151-00001...Coved Rubber Skirting, H=100"],
["A04AL081-00004...Acid/Alkaline Resistant Paint H=100"],
["A04AL078-00004...Acid/Alkaline Resistant Paint, H=1.5"],
["A04AM084-00004...Glazed Ceramic Tile, H=100"]
];
# ----------------------------------------
interior_finish_ceiling = CodeBlock()
# ---------- interior_finish_ceiling.designscript (8 lines) ----------
[
["A04AL079-00003...Latex Paint"],
["A04AL079-00003...Latex Paint"],
["A04AR156-00002...Acoustic Tiled Ceiling System, T-Bar"],
["A04AR156-00002...Acoustic Tiled Ceiling System, T-Bar"],
["A04AL079-00003...Latex Paint"],
["A04AR157-00002...Moisture Resistant Tiled Ceiling System, T-bar"]
];
# ----------------------------------------
code_block_15 = CodeBlock(a=interior_finish_floor, sep=code_block_14, b=interior_finish_wall, c=interior_finish_skirt, d=interior_finish_ceiling) { a + sep + b + sep + c + sep + d; }  # frozen
interior_finish_type = CodeBlock()
# ---------- interior_finish_type.designscript (8 lines) ----------
[
"IF1",
"IF2",
"IF2-1",
"IF3",
"IF4",
"IF5"
];
# ----------------------------------------
dictionary_bykeysvalues_floor = DesignScript.Builtin.Dictionary.ByKeysValues(keys=interior_finish_type, values=interior_finish_floor)
dictionary_bykeysvalues_ceiling = DesignScript.Builtin.Dictionary.ByKeysValues(keys=interior_finish_type, values=interior_finish_ceiling)
code_block_16 = CodeBlock { "IF3"; }
valueAtKey = DesignScript.Builtin.Dictionary.ValueAtKey(dictionary=dictionary_bykeysvalues_ceiling, key=code_block_16)
dictionary_bykeysvalues_skirt = DesignScript.Builtin.Dictionary.ByKeysValues(keys=interior_finish_type, values=interior_finish_skirt)
code_block_17 = CodeBlock { "IF3"; }
valueAtKey_2 = DesignScript.Builtin.Dictionary.ValueAtKey(dictionary=dictionary_bykeysvalues_skirt, key=code_block_17)
dictionary_bykeysvalues_wall = DesignScript.Builtin.Dictionary.ByKeysValues(keys=interior_finish_type, values=interior_finish_wall)
code_block_18 = CodeBlock { "IF5"; }
valueAtKey_3 = DesignScript.Builtin.Dictionary.ValueAtKey(dictionary=dictionary_bykeysvalues_wall, key=code_block_18)
