# Dynamo graph test 08231_mk.dyn (Dynamo 2.10.1.3976)

code_block = CodeBlock { 10; 20; }
byWidthLength = Rectangle.ByWidthLength(width=code_block.out0, length=code_block.out1)
code_block_2 = CodeBlock { 10; }
code_block_3 = CodeBlock { 10; }
code_block_4 = CodeBlock { 10; }
byCoordinates = Point.ByCoordinates()
number_slider = DoubleSlider(-39.784, range=-39.784..100 step 0.1)
number_slider_2 = DoubleSlider(-50.301, range=-50.301..100 step 0.1)
byCoordinates_2 = Point.ByCoordinates(x=number_slider, y=number_slider_2)
watch = Watch(byCoordinates_2)
number_slider_3 = DoubleSlider(55.272, range=0..100 step 0.1)
number_slider_4 = DoubleSlider(-1.642, range=-1.642..100 step 0.1)
byCoordinates_3 = Point.ByCoordinates(x=number_slider_3, y=number_slider_4)
watch_2 = Watch(byCoordinates_3)
number_slider_5 = DoubleSlider(7.227, range=0..100 step 0.1)
number_slider_6 = DoubleSlider(-31.014, range=-31.077..100 step 0.1)
byCoordinates_4 = Point.ByCoordinates(x=number_slider_5, y=number_slider_6)
watch_3 = Watch(byCoordinates_4)
join = List.Join(list0=watch, list1=watch_2, list2=watch_3)
X = Point.X(point=byCoordinates_3)
Y = Point.Y(point=byCoordinates_3)
byOrigin = CoordinateSystem.ByOrigin(x=X, y=Y)
code_block_5 = CodeBlock { 5..15..5; }
byWidthLength_2 = Rectangle.ByWidthLength(cs=byOrigin, width=code_block_5, length=code_block_5)
code_block_6 = CodeBlock(a=byWidthLength_2) { a[0]; a[1]; a[2]; }
code_block_7 = CodeBlock { 10; }
translate = Geometry.Translate(geometry=code_block_6.out0, xTranslation=code_block_7)
code_block_8 = CodeBlock { 12.5; }
translate_2 = Geometry.Translate(geometry=code_block_6.out1, yTranslation=code_block_8)
translate_3 = Geometry.Translate(geometry=code_block_6.out2)
join_2 = List.Join(list0=translate, list1=translate_2, list2=translate_3)
ZAxis = Vector.ZAxis()
code_block_9 = CodeBlock { 90; }
rotate = Geometry.Rotate(geometry=join_2, origin=byCoordinates_3, axis=ZAxis, degrees=code_block_9)
byPatch = Surface.ByPatch(closedCurve=rotate)
byJoinedSurfaces = PolySurface.ByJoinedSurfaces(surfaces=byPatch)
surfaces = PolySurface.Surfaces(polySurface=byJoinedSurfaces)
shakeRoomSurfaces = Custom[ShakeRoomSurfaces]()  # ShakeRoomSurfaces; unwired: input
X_2 = Point.X(point=byCoordinates_2)
Y_2 = Point.Y(point=byCoordinates_2)
byOrigin_2 = CoordinateSystem.ByOrigin(x=X_2, y=Y_2)
code_block_10 = CodeBlock { 5..15..5; }
byWidthLength_3 = Rectangle.ByWidthLength(cs=byOrigin_2, width=code_block_10, length=code_block_10)
code_block_11 = CodeBlock(a=byWidthLength_3) { a[0]; a[1]; a[2]; }
code_block_12 = CodeBlock { 10; }
translate_4 = Geometry.Translate(geometry=code_block_11.out0, xTranslation=code_block_12)
code_block_13 = CodeBlock { 12.5; }
translate_5 = Geometry.Translate(geometry=code_block_11.out1, yTranslation=code_block_13)
translate_6 = Geometry.Translate(geometry=code_block_11.out2)
join_3 = List.Join(list0=translate_4, list1=translate_5, list2=translate_6)
byPatch_2 = Surface.ByPatch(closedCurve=join_3)
byJoinedSurfaces_2 = PolySurface.ByJoinedSurfaces(surfaces=byPatch_2)
perimeterCurves = Surface.PerimeterCurves(surface=byJoinedSurfaces_2)
perimeterCurves_2 = Surface.PerimeterCurves(surface=byJoinedSurfaces)
X_3 = Point.X(point=byCoordinates_4)
Y_3 = Point.Y(point=byCoordinates_4)
byOrigin_3 = CoordinateSystem.ByOrigin(x=X_3, y=Y_3)
code_block_14 = CodeBlock { 5..15..5; }
byWidthLength_4 = Rectangle.ByWidthLength(cs=byOrigin_3, width=code_block_14, length=code_block_14)
code_block_15 = CodeBlock(a=byWidthLength_4) { a[0]; a[1]; a[2]; }
code_block_16 = CodeBlock { 10; }
translate_7 = Geometry.Translate(geometry=code_block_15.out0, xTranslation=code_block_16)
code_block_17 = CodeBlock { 12.5; }
translate_8 = Geometry.Translate(geometry=code_block_15.out1, yTranslation=code_block_17)
translate_9 = Geometry.Translate(geometry=code_block_15.out2)
join_4 = List.Join(list0=translate_7, list1=translate_8, list2=translate_9)
ZAxis_2 = Vector.ZAxis()
code_block_18 = CodeBlock { 180; }
rotate_2 = Geometry.Rotate(geometry=join_4, origin=byCoordinates_4, axis=ZAxis_2, degrees=code_block_18)
byPatch_3 = Surface.ByPatch(closedCurve=rotate_2)
byJoinedSurfaces_3 = PolySurface.ByJoinedSurfaces(surfaces=byPatch_3)
perimeterCurves_3 = Surface.PerimeterCurves(surface=byJoinedSurfaces_3)
list_create = List.Create(item0=perimeterCurves, item1=perimeterCurves_2, item2=perimeterCurves_3)
byJoinedCurves = PolyCurve.ByJoinedCurves(curves=list_create)
byPatch_4 = Surface.ByPatch(closedCurve=byJoinedCurves)
code_block_19 = CodeBlock { 50; 100; }
byWidthLength_5 = Rectangle.ByWidthLength(width=code_block_19.out1, length=code_block_19.out0)
explode = Geometry.Explode(geometry=byWidthLength_5)
byJoinedCurves_2 = PolyCurve.ByJoinedCurves(curves=explode)
python_script = Python(IN[0]=byPatch_4, IN[1]=byJoinedCurves_2)  # CPython3
# ---------- python_script.python (274 lines) ----------
# Python 표준 및 DesignScript 라이브러리 로드
from random import randint
import sys
import clr
clr.AddReference('ProtoGeometry')
clr.AddReference('DSCoreNodes')
from DSCore import *
from Autodesk.DesignScript.Geometry import *



def GetXOrderSurfaces(sl):
    ls = []
    for s in sl:
        ls.append(SortByMinX(s))

    ls.sort()

    r = []
    for l in ls:
        r.append(l.val)

    return r

def GetYOrderSurfaces(sl):
    ls = []
    for s in sl:
        ls.append(SortByMinY(s))

    ls.sort()

    r = []
    for l in ls:
        r.append(l.val)

    return r

def GetIndexOfSurface(s, sl):
    for i in range(0, len(sl)):
        if sl[i] == s:
            return i

def GetSurfaceMinX(s):
    a1 = Math.Min(s.PointAtParameter(0,0).X, s.PointAtParameter(0,1).X)
    a2 = Math.Min(s.PointAtParameter(1,0).X, s.PointAtParameter(1,1).X)
    return Math.Min(a1, a2)

def GetSurfaceMaxX(s):
    a1 = Math.Max(s.PointAtParameter(0,0).X, s.PointAtParameter(0,1).X)
    a2 = Math.Max(s.PointAtParameter(1,0).X, s.PointAtParameter(1,1).X)
    return Math.Max(a1, a2)

def GetSurfaceMinY(s):
    a1 = Math.Min(s.PointAtParameter(0,0).Y, s.PointAtParameter(0,1).Y)
    a2 = Math.Min(s.PointAtParameter(1,0).Y, s.PointAtParameter(1,1).Y)
    return Math.Min(a1, a2)

def GetSurfaceMaxY(s):
    a1 = Math.Max(s.PointAtParameter(0,0).Y, s.PointAtParameter(0,1).Y)
    a2 = Math.Max(s.PointAtParameter(1,0).Y, s.PointAtParameter(1,1).Y)
    return Math.Max(a1, a2)


class SortByMinX(object):
     def __init__(self, val):
         self.val = val

     def __lt__(self, other):
         return GetSurfaceMinX(self.val) < GetSurfaceMinX(other.val)

class SortByMinY(object):
     def __init__(self, val):
         self.val = val

     def __lt__(self, other):
         return GetSurfaceMinY(self.val) < GetSurfaceMinY(other.val)


def CreateXCheckerSurface(s):
    minX = GetSurfaceMinX(s)
    minY = GetSurfaceMinY(s)
    maxX = GetSurfaceMaxX(s)
    maxY = GetSurfaceMaxY(s)
    minZ = s.PointAtParameter(0,0).Z
    pl = [
            Point.ByCoordinates(minX - 100000, minY + 0.1, minZ),
            Point.ByCoordinates(minX - 100000, maxY - 0.1, minZ),
            Point.ByCoordinates(minX, maxY - 0.1, minZ),
            Point.ByCoordinates(minX, minY + 0.1, minZ),
        ]

    checkerX = Surface.ByPerimeterPoints(pl)

    return checkerX

def CreateYCheckerSurface(s):
    minX = GetSurfaceMinX(s)
    minY = GetSurfaceMinY(s)
    maxX = GetSurfaceMaxX(s)
    maxY = GetSurfaceMaxY(s)
    minZ = s.PointAtParameter(0,0).Z
    pl = [
            Point.ByCoordinates(minX + 0.1, minY - 100000, minZ),
            Point.ByCoordinates(minX + 0.1, minY, minZ),
            Point.ByCoordinates(maxX - 0.1, minY, minZ),
            Point.ByCoordinates(maxX - 0.1, minY - 100000, minZ),
        ]

    checkerX = Surface.ByPerimeterPoints(pl)

    return checkerX

def GetDistanceXToMove(s, sl):
    checkerX = CreateXCheckerSurface(s)

    cl = []

    noHit = True

    for si in sl:
        if si == s:
            continue
        else:
            if checkerX.DoesIntersect(si) == True:
                noHit = False

                cl.append(si.PointAtParameter(0,0).X)
                cl.append(si.PointAtParameter(0,1).X)
                cl.append(si.PointAtParameter(1,0).X)
                cl.append(si.PointAtParameter(1,1).X)

    if noHit == True:
        return - GetSurfaceMinX(s)
    else:
        cl.sort(reverse=True)
        return cl[0] - GetSurfaceMinX(s)

def GetDistanceYToMove(s, sl):
    checkerY = CreateYCheckerSurface(s)

    cl = []

    noHit = True

    for si in sl:
        if si == s:
            continue
        else:
            if checkerY.DoesIntersect(si) == True:
                noHit = False

                cl.append(si.PointAtParameter(0,0).Y)
                cl.append(si.PointAtParameter(0,1).Y)
                cl.append(si.PointAtParameter(1,0).Y)
                cl.append(si.PointAtParameter(1,1).Y)

    if noHit == True:
        return - GetSurfaceMinY(s)
    else:
        cl.sort(reverse=True)
        return cl[0] - GetSurfaceMinY(s)


def MoveX():
    xOrdered = GetXOrderSurfaces(surfacelist)

    for s in xOrdered:    
        toMoveX = GetDistanceXToMove(s, surfacelist)
        idx = GetIndexOfSurface(s, surfacelist)
        surfacelist[idx] = Geometry.Translate(surfacelist[idx], toMoveX, 0, 0)

def MoveY():
    yOrdered = GetYOrderSurfaces(surfacelist)

    for s in yOrdered:
        toMoveY = GetDistanceYToMove(s, surfacelist)
        idx = GetIndexOfSurface(s, surfacelist)
        surfacelist[idx] = Geometry.Translate(surfacelist[idx], 0, toMoveY, 0)

def SplitX():
    xOrdered = GetXOrderSurfaces(surfacelist)

    offsetX = 0   
    for i in range(0, len(xOrdered)):
        idx = GetIndexOfSurface(xOrdered[i], surfacelist)

        mx = offsetX - GetSurfaceMinX(surfacelist[idx])
        surfacelist[idx] = Geometry.Translate(surfacelist[idx], mx, 0, 0)

        sx = GetSurfaceMaxX(surfacelist[idx]) - GetSurfaceMinX(surfacelist[idx])
        offsetX = offsetX + sx

def SplitY():
    yOrdered = GetYOrderSurfaces(surfacelist)

    offsetY = 0   
    for i in range(0, len(yOrdered)):
        idx = GetIndexOfSurface(yOrdered[i], surfacelist)

        my = offsetY - GetSurfaceMinY(surfacelist[idx])
        surfacelist[idx] = Geometry.Translate(surfacelist[idx], 0, my, 0)

        sy = GetSurfaceMaxY(surfacelist[idx]) - GetSurfaceMinY(surfacelist[idx])
        offsetY = offsetY + sy

def MinofAll():
    allX = []
    allY = []
    for s in surfacelist:
        allX.append(GetSurfaceMinX(s))
        allY.append(GetSurfaceMinY(s))
    allX.sort()
    allY.sort()
    x = 0
    if allX[0] < 0:
        x = -allX[0]
    y = 0
    if allY[0] < 0:
        y = -allY[0]

    return x,y

def FindBoundaryPoint(crv):
    x = crv.PointAtParameter(0).X
    y = crv.PointAtParameter(0).Y
    
    return x,y


# 이 노드에 대한 입력값은 IN 변수에 리스트로 저장됩니다.
dataEnteringNode = IN

# 코드를 이 선 아래에 배치

surfaces = IN[0]
bdCrv = IN[1]

surfacelist = []
for s in surfaces:
    surfacelist.append(s)

#(basX, basY) = MinofAll()
(basX, basY) = FindBoundaryPoint(bdCrv)
#(basX, basY) = 0, 0

for i in range(0, len(surfacelist)):
    #moveToX = 
    surfacelist[i] = Geometry.Translate(surfacelist[i], basX, basY, 0)

    if randint(0, 1) == 0:
        SplitX()
        MoveX()
        MoveY()
        MoveX()
        MoveY()
    else:
        SplitY()
        MoveY()
        MoveX()
        MoveY()
        MoveX()

# testnum = IN[1]
# xOrdered = GetXOrderSurfaces(surfacelist)

# # for s in xOrdered:    
# toMoveX = GetDistanceXToMove(xOrdered[testnum], surfacelist)
# idx = GetIndexOfSurface(xOrdered[testnum], surfacelist)
# surfacelist[idx] = Geometry.Translate(surfacelist[idx], toMoveX, 0, 0)



# 출력을 OUT 변수에 지정합니다.
OUT = GetYOrderSurfaces(surfaces)#surfacelist
# ----------------------------------------
code_block_20 = CodeBlock { 1; }
pointAtParameter = Surface.PointAtParameter(surface=byPatch_4, u=code_block_20, v=code_block_20)
python_script_2 = Python(IN[0]=byPatch_4, IN[1]=byJoinedCurves_2)  # IronPython2
# ---------- python_script_2.python (22 lines) ----------
# Load the Python Standard and DesignScript Libraries
import sys
import clr
clr.AddReference('ProtoGeometry')
from Autodesk.DesignScript.Geometry import *

# The inputs to this node will be stored as a list in the IN variables.
dataEnteringNode = IN
surfaceList = IN[0]
bldgBoundary = IN[1]

# Place your code below this line
a = bldgBoundary.PointAtParameter(0)

boxPerimeter = []
for surface in surfaceList:
    templist = []
    templist.append(surface.PerimeterCurves())
    boxPerimeter.append(ByJoinedCurves(templist))
    templist = []
# Assign your output to the OUT variable.
OUT = boxPerimeter
# ----------------------------------------
