# Dynamo graph 2-2_Room Generating(0701)ss.dyn (Dynamo 2.10.1.3976)
# packages: MEPover 2020.6.2

# group: Room 자동 생성 구간
python_script = Python()  # IronPython2; unwired: IN[0]
# ---------- python_script.python (49 lines) ----------
import clr

clr.AddReference("RevitServices")
import RevitServices
from RevitServices.Persistence import DocumentManager
from RevitServices.Transactions import TransactionManager
doc = DocumentManager.Instance.CurrentDBDocument

clr.AddReference("RevitAPI")
import Autodesk
from Autodesk.Revit.DB import *

clr.AddReference("RevitNodes")
import Revit
clr.ImportExtensions(Revit.Elements)
clr.ImportExtensions(Revit.GeometryConversion)

collector = FilteredElementCollector(doc)
levels = collector.OfClass(Level).ToElements()

phase = UnwrapElement(IN[0])
limitoffset = 8
listout = []

for j,level in enumerate(levels):
	try:
		planTopology = doc.get_PlanTopology(level)
		rooms = []
		
		for i,plancircuit in enumerate(planTopology.Circuits):
			if plancircuit.IsRoomLocated == True:
				continue
			TransactionManager.Instance.EnsureInTransaction(doc)
			room = doc.Create.NewRoom(phase)
			room.Name = "Name" + str(i)
			room.Number = str(j) + "." + str(i)
			room.LimitOffset = limitoffset
			try:
				room2 = doc.Create.NewRoom(room,plancircuit)
			except:
				continue
			TransactionManager.Instance.TransactionTaskDone()
			rooms.append(room2)
		listout.append(rooms)
	except:
		continue


OUT = listout
# ----------------------------------------
select_phase = RevitPhases("New Construction")  # graph input
rooms_place_automatically_for = Custom[Rooms place automatically for all levels](Phase=select_phase)  # package MEPover; This node will attempt to create rooms automatically for every level

watch = Watch(rooms_place_automatically_for)
flatten = List.Flatten(list=watch)
code_block = CodeBlock { "Name"; }
code_block_2 = CodeBlock { "a"; }
setParameterByName = Element.SetParameterByName(element=flatten, parameterName=code_block, value=code_block_2)
flatten_2 = List.Flatten(list=setParameterByName)
watch_2 = Watch(flatten_2)
all_elements_in_active_view = ElementsInView()
watch_3 = Watch(all_elements_in_active_view)
name = Element.Name(element=watch_3)
code_block_3 = CodeBlock { "Room"; "Space Planning Box"; }
contains = List.Contains(list=name, item=code_block_3.out1, lacing=Longest)
filterByBoolMask = List.FilterByBoolMask(list=watch_3, mask=contains)
watch_4 = Watch(filterByBoolMask.in)
geometry = Element.Geometry(element=flatten_2)
centroid = Solid.Centroid(solid=geometry)
flatten_3 = List.Flatten(list=centroid)
geometry_2 = Element.Geometry(element=watch_4)
flatten_4 = List.Flatten(list=geometry_2)
doesIntersect = Geometry.DoesIntersect(geometry=flatten_3, other=flatten_4, lacing=CrossProduct)
watch_5 = Watch(doesIntersect)
filterByBoolMask_2 = List.FilterByBoolMask(list=watch_4, mask=watch_5@L2)
watch_6 = Watch(filterByBoolMask_2.in)
count = List.Count(list=watch_6@L2)
watch_7 = Watch(count)
code_block_4 = CodeBlock(a=watch_7) { a>1; }
watch_8 = Watch(code_block_4)
filterByBoolMask_3 = List.FilterByBoolMask(list=filterByBoolMask_2.in, mask=watch_8)
watch_9 = Watch(filterByBoolMask_3.out)
geometry_3 = Element.Geometry(element=watch_9)
flatten_5 = List.Flatten(list=geometry_3)
geometry_4 = Element.Geometry(element=watch_2)
centroid_2 = Solid.Centroid(solid=geometry_4)
flatten_6 = List.Flatten(list=centroid_2)
doesIntersect_2 = Geometry.DoesIntersect(geometry=flatten_5, other=flatten_6, lacing=CrossProduct)
filterByBoolMask_4 = List.FilterByBoolMask(list=watch_2, mask=doesIntersect_2@L2)
watch_10 = Watch(filterByBoolMask_4.in)
area = Room.Area()  # unwired: room
maximumItemByKey = List.MaximumItemByKey(list=watch_10@L2, keyFunction=area)
watch_11 = Watch(maximumItemByKey)
code_block_5 = CodeBlock { "Name"; }
flatten_7 = List.Flatten(list=watch_9)
watch_12 = Watch(flatten_7)
code_block_6 = CodeBlock { "Room Name"; }
getParameterValueByName = Element.GetParameterValueByName(element=watch_12, parameterName=code_block_6)
watch_13 = Watch(getParameterValueByName)
setParameterByName_2 = Element.SetParameterByName(element=watch_11, parameterName=code_block_5, value=watch_13)
watch_14 = Watch(filterByBoolMask_3.in)
flatten_8 = List.Flatten(list=watch_14)
uniqueItems = List.UniqueItems(list=flatten_8)

# group: 3개 겹침
code_block_7 = CodeBlock {  }
code_block_8 = CodeBlock {  }

watch_15 = Watch(watch_2)
count_2 = List.Count(list=watch_14@L2)
code_block_9 = CodeBlock { 3; }
eq = count_2 == code_block_9
filterByBoolMask_5 = List.FilterByBoolMask(list=watch_14, mask=eq)
watch_16 = Watch(filterByBoolMask_5.in)
flatten_9 = List.Flatten(list=watch_16)
code_block_10 = CodeBlock { "Area"; }
getParameterValueByName_2 = Element.GetParameterValueByName(parameterName=code_block_10)  # unwired: element
maximumItemByKey_2 = List.MaximumItemByKey(list=flatten_9, keyFunction=getParameterValueByName_2)
geometry_5 = Element.Geometry(element=maximumItemByKey_2)
watch_17 = Watch(flatten_3)
doesIntersect_3 = Geometry.DoesIntersect(geometry=geometry_5, other=watch_17, lacing=Longest)
filterByBoolMask_6 = List.FilterByBoolMask(list=watch_15, mask=doesIntersect_3)
watch_18 = Watch(filterByBoolMask_6.in)
code_block_11 = CodeBlock { "Area"; }
getParameterValueByName_3 = Element.GetParameterValueByName(parameterName=code_block_11)  # unwired: element
sortByKey = List.SortByKey(list=watch_18@L1, keys=getParameterValueByName_3)
watch_19 = Watch(sortByKey.sortedList)
flatten_10 = List.Flatten(list=watch_19)
code_block_12 = CodeBlock { "Name"; }
code_block_13 = CodeBlock { "Area"; }
getParameterValueByName_4 = Element.GetParameterValueByName(parameterName=code_block_13)  # unwired: element
sortByKey_2 = List.SortByKey(list=flatten_9@L1, keys=getParameterValueByName_4)
watch_20 = Watch(sortByKey_2.sortedList)
flatten_11 = List.Flatten(list=watch_20)
code_block_14 = CodeBlock { "Room Name"; }
getParameterValueByName_5 = Element.GetParameterValueByName(element=flatten_11, parameterName=code_block_14)
watch_21 = Watch(getParameterValueByName_5)
setParameterByName_3 = Element.SetParameterByName(element=flatten_10, parameterName=code_block_12, value=watch_21)

# group: 1:1 겹침 없음
code_block_15 = CodeBlock {  }
code_block_16 = CodeBlock {  }

# group: 2개 겹침
code_block_17 = CodeBlock {  }
code_block_18 = CodeBlock {  }

count_3 = List.Count(list=watch_10@L2)
watch_22 = Watch(count_3)
code_block_19 = CodeBlock(a=watch_22) { a==2; }
watch_23 = Watch(code_block_19)
filterByBoolMask_7 = List.FilterByBoolMask(list=watch_10, mask=watch_23)
watch_24 = Watch(filterByBoolMask_7.in)
flatten_12 = List.Flatten(list=watch_24)
watch_25 = Watch(flatten_12)
code_block_20 = CodeBlock { "Name"; }
watch_26 = Watch(filterByBoolMask_3.in)
flatten_13 = List.Flatten(list=watch_26)
geometry_6 = Element.Geometry(element=watch_24)
centroid_3 = Solid.Centroid(solid=geometry_6)
flatten_14 = List.Flatten(list=centroid_3)
geometry_7 = Element.Geometry(element=flatten_13)
flatten_15 = List.Flatten(list=geometry_7)
doesIntersect_4 = Geometry.DoesIntersect(geometry=flatten_14, other=flatten_15, lacing=CrossProduct)
watch_27 = Watch(doesIntersect_4)
filterByBoolMask_8 = List.FilterByBoolMask(list=flatten_13, mask=watch_27@L2)
watch_28 = Watch(filterByBoolMask_8.in)
code_block_21 = CodeBlock { "Area"; }
getParameterValueByName_6 = Element.GetParameterValueByName(parameterName=code_block_21)  # unwired: element
minimumItemByKey = List.MinimumItemByKey(list=watch_28@L2, keyFunction=getParameterValueByName_6)
watch_29 = Watch(minimumItemByKey)
code_block_22 = CodeBlock { "Room Name"; }
getParameterValueByName_7 = Element.GetParameterValueByName(element=watch_29, parameterName=code_block_22)
watch_30 = Watch(getParameterValueByName_7)
setParameterByName_4 = Element.SetParameterByName(element=watch_25, parameterName=code_block_20, value=watch_30)
code_block_23 = CodeBlock { 100; }
byARGB = Color.ByARGB(a=code_block_23, r=code_block_23)
byGeometryColor = Modifiers.GeometryColor.ByGeometryColor(geometry=geometry, color=byARGB)
