# Dynamo graph 3_Modelization(0702).dyn (Dynamo 2.10.1.3976)

categories = Categories("OST_Rooms")
all_elements_of_category = ElementsOfCategory(Category=categories)

# group: 룸 바운더리 추출
coreBoundary = Room.CoreBoundary(room=all_elements_of_category)
code_block = CodeBlock { 1; }
flatten = List.Flatten(list=coreBoundary, amt=code_block)

watch = Watch(flatten)

# group: 룸 중점 외곽선 라인 생성
startPoint = Curve.StartPoint(curve=flatten)
boolean = BoolSelector(true)
byPoints = PolyCurve.ByPoints(points=startPoint, connectLastToFirst=boolean)
byPatch = Surface.ByPatch(closedCurve=byPoints)
code_block_2 = CodeBlock { 0.5; }
pointAtParameter = Surface.PointAtParameter(surface=byPatch, u=code_block_2, v=code_block_2)
graham_scan = Python(IN[0]=pointAtParameter)  # IronPython2
# ---------- graham_scan.python (55 lines) ----------
import clr
clr.AddReference('ProtoGeometry')
from Autodesk.DesignScript.Geometry import *

def ToVals(pt):
	return [pt.X,pt.Y,pt.Z]

def ToPts(ptVals):
	return Point.ByCoordinates(ptVals[0],ptVals[1],ptVals[2])

def CreateOutline(pts):
	crvs = []
	i = 0
	while i < len(pts):
		if i == len(pts)-1:
			crvs.append(Line.ByStartPointEndPoint(pts[i],pts[0]))
		else:
			crvs.append(Line.ByStartPointEndPoint(pts[i],pts[i+1]))
		i = i+1
	return PolyCurve.ByJoinedCurves(crvs)

'''
Taken from Thomas Switzers awesome GitHub repo and modified to suit Dynamo Context
https://gist.github.com/arthur-e/5cf52962341310f438e96c1f3c3398b8
I take zero credit for this work other than porting it across.
'''
def convex_hull_graham(points):
	'''
	Returns points on convex hull in CCW order according to Graham's scan algorithm. 
	By Tom Switzer <thomas.switzer@gmail.com>.
	'''
	TURN_LEFT, TURN_RIGHT, TURN_NONE = (1, -1, 0)

	def cmp(a, b):
		return (a > b) - (a < b)
	
	def turn(p, q, r):
		return cmp((q[0] - p[0])*(r[1] - p[1]) - (r[0] - p[0])*(q[1] - p[1]), 0)
	
	def _keep_left(hull, r):
		while len(hull) > 1 and turn(hull[-2], hull[-1], r) != TURN_LEFT:
			hull.pop()
		if not len(hull) or hull[-1] != r:
			hull.append(r)
		return hull

	points = [ToVals(p) for p in points]	
	points = sorted(points)
	l = reduce(_keep_left, points, [])
	u = reduce(_keep_left, reversed(points), [])
	points = l.extend(u[i] for i in range(1, len(u) - 1)) or l
	points = [ToPts(p) for p in points]
	return CreateOutline(points)

OUT = convex_hull_graham(IN[0])
# ----------------------------------------

# group: 룸 중점 연결외곽라인의 바운딩 박스 추출 및 해당 바운딩박스 형상의 사각형 생성
boundingBox = Geometry.BoundingBox(geometry=graham_scan)
minPoint = BoundingBox.MinPoint(boundingBox=boundingBox)
maxPoint = BoundingBox.MaxPoint(boundingBox=boundingBox)
byTwoPoints = Vector.ByTwoPoints(start=minPoint, end=maxPoint)
X = Vector.X(vector=byTwoPoints)
translate = Geometry.Translate(geometry=minPoint, xTranslation=X)
Y = Vector.Y(vector=byTwoPoints)
translate_2 = Geometry.Translate(geometry=minPoint, yTranslation=Y)
join = List.Join(list0=translate, list1=minPoint, list2=translate_2, list3=maxPoint)

byCornerPoints = Rectangle.ByCornerPoints(points=join)

# group: 내, 외벽 라인 판별 구간
flatten_2 = List.Flatten(list=watch)
patch = Curve.Patch(curve=byCornerPoints)
doesIntersect = Geometry.DoesIntersect(geometry=flatten_2, other=patch)
filterByBoolMask = List.FilterByBoolMask(list=flatten_2, mask=doesIntersect)

watch_2 = Watch(filterByBoolMask.in)

# group: 내벽 커브 중복제거
code_block_3 = CodeBlock { 0.5; }
pointAtParameter_2 = Curve.PointAtParameter(curve=watch_2, param=code_block_3)
string_from_object = FromObject(object=pointAtParameter_2)
uniqueItems = List.UniqueItems(list=string_from_object)
allIndicesOf = List.AllIndicesOf(list=string_from_object, item=uniqueItems)
firstItem = List.FirstItem(list=allIndicesOf@L2)
getItemAtIndex = List.GetItemAtIndex(list=watch_2, index=firstItem)

# group: 현재 작업중 레벨 정보 추출 구간
code_block_4 = CodeBlock { "Level"; }
getParameterValueByName = Element.GetParameterValueByName(element=all_elements_of_category, parameterName=code_block_4)
uniqueItems_2 = List.UniqueItems(list=getParameterValueByName)
firstItem_2 = List.FirstItem(list=uniqueItems_2)

# group: 현재 작업중 레벨 선택 구간
categories_2 = Categories("OST_Levels")
all_elements_of_category_2 = ElementsOfCategory(Category=categories_2)
name = Element.Name(element=all_elements_of_category_2)
contains = String.Contains(str=name, searchFor=firstItem_2)
filterByBoolMask_2 = List.FilterByBoolMask(list=all_elements_of_category_2, mask=contains)
firstItem_3 = List.FirstItem(list=filterByBoolMask_2.in)

# group: 내벽 생성 구간
watch_3 = Watch(getItemAtIndex)
code_block_5 = CodeBlock { 3000; }
code_block_6 = CodeBlock { "Wall-Int_12P-100Blk-12P"; }
byName = WallType.ByName(name=code_block_6)
byCurveAndHeight = Wall.ByCurveAndHeight(curve=watch_3, height=code_block_5, level=firstItem_3, wallType=byName)

# group: 외벽 생성 구간
watch_4 = Watch(filterByBoolMask.out)
code_block_7 = CodeBlock { 3000; }
code_block_8 = CodeBlock { "Wall-Ext_215Bwk"; }
byName_2 = WallType.ByName(name=code_block_8)
byCurveAndHeight_2 = Wall.ByCurveAndHeight(curve=watch_4, height=code_block_7, level=firstItem_3, wallType=byName_2)

categories_3 = Categories("OST_Grids")
all_elements_of_category_3 = ElementsOfCategory(Category=categories_3)
curve = Grid.Curve(grid=all_elements_of_category_3)
direction = Line.Direction(line=curve)
normalized = Vector.Normalized(vector=direction)
watch_5 = Watch(normalized)
X_2 = Vector.X(vector=watch_5)
round = Math.Round(number=X_2)
watch_6 = Watch(round)
code_block_9 = CodeBlock { 0; }
eq = watch_6 == code_block_9
filterByBoolMask_3 = List.FilterByBoolMask(list=curve, mask=eq)
watch_7 = Watch(filterByBoolMask_3.in)
watch_8 = Watch(filterByBoolMask_3.out)
intersect = Geometry.Intersect(geometry=watch_7, other=watch_8, lacing=CrossProduct)
watch_9 = Watch(intersect)
flatten_3 = List.Flatten(list=watch_9)
watch_10 = Watch(flatten_3)
flatten_4 = List.Flatten(list=watch_10)
code_block_10 = CodeBlock { 20000; }
translate_3 = Geometry.Translate(geometry=watch_10, zTranslation=code_block_10)
flatten_5 = List.Flatten(list=translate_3)
byStartPointEndPoint = Line.ByStartPointEndPoint(startPoint=flatten_4, endPoint=flatten_5)

# group: 기둥 생성 구간
watch_11 = Watch(byStartPointEndPoint)
levels = Levels("2nd")
structural_column_types = StructuralColumnTypes("UC305x305x97")
columnByCurve = StructuralFraming.ColumnByCurve(curve=watch_11, level=levels, structuralColumnType=structural_column_types)

Y_2 = Vector.Y(vector=watch_5)
round_2 = Math.Round(number=Y_2)
watch_12 = Watch(round_2)

# group: Column
code_block_11 = CodeBlock {  }
code_block_12 = CodeBlock {  }

# group: Wall
code_block_13 = CodeBlock {  }
code_block_14 = CodeBlock {  }

# group: Foundation
code_block_15 = CodeBlock {  }
code_block_16 = CodeBlock {  }

# group: 기초
family_types = FamilyTypes("FT112-Footing-Rectangular:FT112_2400x2400x500")
watch_13 = Watch(watch_10)
X_3 = Point.X(point=watch_13)
Y_3 = Point.Y(point=watch_13)
Z = Point.Z(point=watch_13)
byCoordinates = FamilyInstance.ByCoordinates(familyType=family_types, x=X_3, y=Y_3, z=Z)
