# Dynamo graph 0720 space planning test 001.dyn (Dynamo 2.10.1.3976)
# packages: DynaShape 0.6.1.0, DynaShape (for Dynamo 2.7 or newer) 0.7.11.0, GenerativeDesign 1.7.3.0, GenerativeDesign.Revit 1.7.3.0, GenerativeDesignVisualizer3000™ 2021.5.5, Clockwork for Dynamo 2.x 2.3.0, BumbleBee 2021.25.3

# group: Engine settings for GDIR mode
code_block = CodeBlock { 200000; 0.0001; 30000; 60000; 90000; }
code_block_2 = CodeBlock { 150000; 0.0001; 10000; 20000; 30000; }
# note: Custom Package: DynaSpace
create = DynaSpace.SilentModeSettings.Create(maxIterationCount=code_block_2.out0, terminationThreshold=code_block_2.out1, sphereCollisionKickin=code_block_2.out2, planarConstraintKickin=code_block_2.out3, boundaryKickin=code_block_2.out4)

# group: User Inputs for GDIR
seed_for_initial_positions = DoubleSlider(335, range=0..999 step 1)  # graph input
# note: Custom Package: GenerativeDesign v.2021.5.5
select_room_to_load_program_into = DSModelRoomSelection()  # 1 picked in the model; graph input

# group: Bring in the space specification data from the CSV file
file_path = Filename(".\space planning test 0715 001.xlsx")
file_from_path = FileObject(path=file_path)
code_block_3 = CodeBlock { "Sheet1"; "SampleBuildingProgram-Clinic"; false; }
importExcel = Data.ImportExcel(file=file_from_path, sheetName=code_block_3.out1)

code_block_4 = CodeBlock { -1; }
dropItems = List.DropItems(list=importExcel@L2, amount=code_block_4)
seed = DoubleSlider(290, range=0..999 step 1)  # graph input

# group: Extract room boundary for DynaSpace and cache it in the graph
# note: Retrieve the room's finish boundary.
# Note: The first sublist is the outermost boundary of the room.
finishBoundary = Room.FinishBoundary(room=select_room_to_load_program_into)
# note: Custom Package: GenerativeDesign v.2021.5.5
remember = Data.Remember(finishBoundary)
firstItem = List.FirstItem(list=remember@L3)
startPoint = Curve.StartPoint(curve=firstItem)
flatten = List.Flatten(list=startPoint)
byJoinedCurves = PolyCurve.ByJoinedCurves(curves=firstItem)

code_block_5 = CodeBlock { 1; 2; }

# group: Background
code_block_6 = CodeBlock { 100; 10; 100; 10000; 10000; 5; }
# note: Custom Package: DynaSpace
create_2 = DynaSpace.Settings.Create(dampingFactor=code_block_5.out0, boundaryStrength=code_block_6.out0, planarConstraintStrength=code_block_6.out1, sphereCollisionStrength=code_block_6.out2, spaceDepartmentAdjacencyStrength=code_block_6.out5)

# group: Display/Validation
the_outermost_room_boundary = Watch3D(byJoinedCurves)

# group: 매스의 중점 최외곽 라인 형성 및 surface 형성
flatten_2 = List.Flatten()  # unwired: list
explode = Geometry.Explode(geometry=flatten_2)
startPoint_2 = Curve.StartPoint(curve=explode)
flatten_3 = List.Flatten(list=startPoint_2)

Z = Point.Z(point=flatten_3)
uniqueItems = List.UniqueItems(list=Z)
eq = Z@L2 == uniqueItems@L1  # lacing=CrossProduct
code_block_7 = CodeBlock { 1; }
flatten_4 = List.Flatten(list=eq, amt=code_block_7)
filterByBoolMask = List.FilterByBoolMask(list=flatten_3@L2, mask=flatten_4@L2)
watch = Watch(filterByBoolMask.in)
code_block_8 = CodeBlock { 0; }
getItemAtIndex = List.GetItemAtIndex(list=watch@L3, index=code_block_8)

# group (continued): 매스의 중점 최외곽 라인 형성 및 surface 형성
graham_scan = Python(IN[0]=getItemAtIndex)  # IronPython2
# ---------- graham_scan.python (55 lines) ----------
import clr
clr.AddReference('ProtoGeometry')
from Autodesk.DesignScript.Geometry import *

def ToVals(pt):
	return [pt.X,pt.Y,pt.Z]

def ToPts(ptVals):
	return Point.ByCoordinates(ptVals[0],ptVals[1],ptVals[2])

def CreateOutline(pts):
	crvs = []
	i = 0
	while i < len(pts):
		if i == len(pts)-1:
			crvs.append(Line.ByStartPointEndPoint(pts[i],pts[0]))
		else:
			crvs.append(Line.ByStartPointEndPoint(pts[i],pts[i+1]))
		i = i+1
	return PolyCurve.ByJoinedCurves(crvs)

'''
Taken from Thomas Switzers awesome GitHub repo and modified to suit Dynamo Context
https://gist.github.com/arthur-e/5cf52962341310f438e96c1f3c3398b8
I take zero credit for this work other than porting it across.
'''
def convex_hull_graham(points):
	'''
	Returns points on convex hull in CCW order according to Graham's scan algorithm. 
	By Tom Switzer <thomas.switzer@gmail.com>.
	'''
	TURN_LEFT, TURN_RIGHT, TURN_NONE = (1, -1, 0)

	def cmp(a, b):
		return (a > b) - (a < b)
	
	def turn(p, q, r):
		return cmp((q[0] - p[0])*(r[1] - p[1]) - (r[0] - p[0])*(q[1] - p[1]), 0)
	
	def _keep_left(hull, r):
		while len(hull) > 1 and turn(hull[-2], hull[-1], r) != TURN_LEFT:
			hull.pop()
		if not len(hull) or hull[-1] != r:
			hull.append(r)
		return hull

	points = [ToVals(p) for p in points]	
	points = sorted(points)
	l = reduce(_keep_left, points, [])
	u = reduce(_keep_left, reversed(points), [])
	points = l.extend(u[i] for i in range(1, len(u) - 1)) or l
	points = [ToPts(p) for p in points]
	return CreateOutline(points)

OUT = convex_hull_graham(IN[0])
# ----------------------------------------
byPatch = Surface.ByPatch(closedCurve=graham_scan)

transpose = List.Transpose(lists=importExcel)
lastItem = List.LastItem(list=transpose)

# group: Cache the data and prepare it
# note: Custom Package: GenerativeDesign v.2021.5.5
remember_2 = Data.Remember(dropItems)
flatten_5 = List.Flatten(list=remember_2)
count = List.Count(list=remember_2)
remember_3 = Data.Remember(lastItem)
remember_4 = Data.Remember(transpose)
code_block_9 = CodeBlock { 0; }
code_block_10 = CodeBlock { 10; }

# group: Generate random initial positions for the space bubbles
code_block_11 = CodeBlock { -25.0; 25.0; 62; }
# note: Custom Package: DynaSpace
randomNumbers = DynaSpace.Util.RandomNumbers(min=code_block_11.out0, max=code_block_11.out1, count=code_block_11.out2, seed=seed)
code_block_12 = CodeBlock { 31; }
chop = List.Chop(list=randomNumbers, lengths=code_block_12)
code_block_13 = CodeBlock { 0; 1; }
getItemAtIndex_2 = List.GetItemAtIndex(list=chop, index=code_block_13.out0)
getItemAtIndex_3 = List.GetItemAtIndex(list=chop, index=code_block_13.out1)
byCoordinates = Point.ByCoordinates(x=getItemAtIndex_2, y=getItemAtIndex_3)
# note: 초기 위치
takeItems = List.TakeItems(list=byCoordinates, amount=count)

# group: Run the DynaSpace engine
# note: Custom Package: DynaSpace
createWithInitialPositions = DynaSpace.Engine.CreateWithInitialPositions(data=flatten_5, initialPositions=takeItems)
code_block_14 = CodeBlock { false; }
execute = DynaSpace.Engine.Execute(engine=createWithInitialPositions, boundaryVertices=flatten, silentModeSettings=create, reset=code_block_14, showSpaceIds=code_block_14, settings=create_2)
watch_2 = Watch(execute.spaceAdjErrorRatios)
watch_3 = Watch(execute.departmentNames)
watch_4 = Watch(execute.spaceNames)
watch_5 = Watch(execute.spaceAdjErrors)
watch_6 = Watch(execute.spaceAdjLines)
# note: department 별로 원 리스트 구분
department_별로_원_리스트_구분 = Watch(execute.spaceCircles)

# group: Results for GDIR
sum = Math.Sum(values=watch_2)
space_adjacency_score_lower_is = Watch(sum)  # "Space Adjacency Score (Lower is Better)"; graph output

# group: Visualize with a smiley face
byGeometry = BoundingBox.ByGeometry(geom=flatten)
minPoint = BoundingBox.MinPoint(boundingBox=byGeometry)
code_block_15 = CodeBlock { -5; }
translate = Geometry.Translate(geometry=minPoint, yTranslation=code_block_15)
# note: Custom Package:
# GenerativeDesignVisualizer3000™
# v.2021.5.5
smileyByOriginAndValue = Custom[SmileyByOriginAndValue](origin=translate, inputValue=sum)  # package GenerativeDesignVisualizer3000™; This will generate a smiley face or frowny face based on the radius, input value and origin. Useful for generative workflows that need scoring in a neater way.

watch_7 = Watch(execute.spaceIds)
count_2 = List.Count(list=watch_7)
# note: Custom Package:
# GenerativeDesignVisualizer3000™
# v.2021.5.5
contrastingColorRange = Custom[ContrastingColorRange](numberOfColors=count_2)  # package GenerativeDesignVisualizer3000™; This generates a contrasting color range with an initial value of 64 distinct colors. If the range requested exceeds that the colors will be closer to one another.
initialPositions = Watch3D(takeItems)
flatten_6 = List.Flatten(list=watch_7)
watch_8 = Watch(flatten_6)
string_from_object = FromObject(object=watch_8)
centerPoint = Circle.CenterPoint(circle=department_별로_원_리스트_구분)
flatten_7 = List.Flatten(list=centerPoint)
watch_9 = Watch(flatten_7)
byKeysValues = DesignScript.Builtin.Dictionary.ByKeysValues(keys=string_from_object, values=watch_9)
watch_10 = Watch(byKeysValues)
sort = List.Sort(list=flatten_6)
watch_11 = Watch(sort)
string_from_object_2 = FromObject(object=watch_11)
valueAtKey = DesignScript.Builtin.Dictionary.ValueAtKey(dictionary=watch_10, key=string_from_object_2)

# group: Level에 따라 Z 값 Dictionary 추출
X = Point.X(point=valueAtKey)
Y = Point.Y(point=valueAtKey)
watch_12 = Watch(remember_3)
code_block_16 = CodeBlock { 1; }
dropItems_2 = List.DropItems(list=watch_12, amount=code_block_16)
uniqueItems_2 = List.UniqueItems(list=dropItems_2)
code_block_17 = CodeBlock { 0..2000..2000; }
byKeysValues_2 = DesignScript.Builtin.Dictionary.ByKeysValues(keys=uniqueItems_2, values=code_block_17)
watch_13 = Watch(byKeysValues_2)
code_block_18 = CodeBlock { 1; }
dropItems_3 = List.DropItems(list=watch_12, amount=code_block_18)
watch_14 = Watch(dropItems_3)
valueAtKey_2 = DesignScript.Builtin.Dictionary.ValueAtKey(dictionary=watch_13, key=watch_14)
watch_15 = Watch(valueAtKey_2)
byCoordinates_2 = Point.ByCoordinates(x=X, y=Y, z=watch_15)

watch_16 = Watch(byCoordinates_2)
code_block_19 = CodeBlock { 1; }
dropItems_4 = List.DropItems(list=remember_4@L2, amount=code_block_19)
watch_17 = Watch(dropItems_4)

# group (continued): Cache the data and prepare it
getItemAtIndex_4 = List.GetItemAtIndex(list=watch_17, index=code_block_9)
watch_18 = Watch(getItemAtIndex_4)
getItemAtIndex_5 = List.GetItemAtIndex(list=watch_17, index=code_block_10)
watch_19 = Watch(getItemAtIndex_5)

watch_20 = Watch(watch_18)
getItemAtIndex_6 = List.GetItemAtIndex(list=watch_16, index=watch_20)
watch_21 = Watch(watch_19)
string_from_object_3 = FromObject(object=watch_21)
watch_22 = Watch(string_from_object_3)
code_block_20 = CodeBlock { ".000000"; }
split = String.Split(str=watch_22@L1, separator0=code_block_20)
code_block_21 = CodeBlock { "."; }
split_2 = String.Split(str=split@L1, separator0=code_block_21)
toNumber = String.ToNumber(str=split_2)
flatten_8 = List.Flatten(list=toNumber)
string_from_object_4 = FromObject(object=flatten_8)
code_block_22 = CodeBlock { 1; }
code_block_23 = CodeBlock { 5; }
remove = String.Remove(string=string_from_object_4, startIndex=code_block_22, count=code_block_23)
watch_23 = Watch(remove)
isNull = Object.IsNull(object=watch_23)
boolean = BoolSelector(false)
allIndicesOf = List.AllIndicesOf(list=isNull, item=boolean)
watch_24 = Watch(allIndicesOf)
getItemAtIndex_7 = List.GetItemAtIndex(list=watch_23, index=watch_24)
replaceItemAtIndex = Custom[List.ReplaceItemAtIndex+](seq=string_from_object_4, indices=watch_24, replacement=getItemAtIndex_7)  # package Clockwork for Dynamo 2.x; Replaces the item at a given index of a list by another item. Unlike the OOTB node, it can replace items at multiple indeces.
toNumber_2 = String.ToNumber(str=replaceItemAtIndex)
getItemAtIndex_8 = List.GetItemAtIndex(list=watch_16, index=toNumber_2)
count_3 = List.Count(list=toNumber@L2)
chop_2 = List.Chop(list=getItemAtIndex_8, lengths=count_3)
byStartPointEndPoint = Line.ByStartPointEndPoint(startPoint=getItemAtIndex_6, endPoint=chop_2, lacing=Shortest)
radius = Circle.Radius(circle=department_별로_원_리스트_구분)
code_block_24 = CodeBlock(a=radius) { a*2; }
byWidthLength = Rectangle.ByWidthLength(width=code_block_24, length=code_block_24)
watch_25 = Watch(byCoordinates_2)
getItemAtIndex_9 = List.GetItemAtIndex(list=watch_25, index=watch_8)
count_4 = List.Count(list=centerPoint@L2)
chop_3 = List.Chop(list=getItemAtIndex_9, lengths=count_4)
X_2 = Point.X(point=chop_3)
Y_2 = Point.Y(point=chop_3)
Z_2 = Point.Z(point=chop_3)
translate_2 = Geometry.Translate(geometry=byWidthLength, xTranslation=X_2, yTranslation=Y_2, zTranslation=Z_2)
byPatch_2 = Surface.ByPatch(closedCurve=translate_2)
code_block_25 = CodeBlock { 2000; }
boolean_2 = BoolSelector(true)
thicken = Surface.Thicken(surface=byPatch_2, thickness=code_block_25, both_sides=boolean_2)

# group: Department Colors - Built as Dictionary based on department names (Contrasty Colors node currently has a limit of 19 colors)
code_block_26 = CodeBlock { 1; }
dropItems_5 = List.DropItems(list=remember_2, amount=code_block_26)
code_block_27 = CodeBlock { 2; }
getItemAtIndex_10 = List.GetItemAtIndex(list=dropItems_5@L2, index=code_block_27)
uniqueItems_3 = List.UniqueItems(list=getItemAtIndex_10)
remember_5 = Data.Remember()  # unwired: arg0
remember_6 = Data.Remember()  # unwired: arg0
remember_7 = Data.Remember()  # unwired: arg0
remember_8 = Data.Remember()  # unwired: arg0
remember_9 = Data.Remember()  # unwired: arg0
remember_10 = Data.Remember()  # unwired: arg0
join = List.Join(list0=remember_5, list1=remember_6, list2=remember_7, list3=remember_8, list4=remember_9, list5=remember_10)
byKeysValues_3 = DesignScript.Builtin.Dictionary.ByKeysValues(keys=uniqueItems_3, values=join)

# group: Visualize the space bubbles with their related color
valueAtKey_3 = DesignScript.Builtin.Dictionary.ValueAtKey(dictionary=byKeysValues_3, key=getItemAtIndex_10)
count_5 = List.Count(list=thicken@L2)
chop_4 = List.Chop(list=valueAtKey_3, lengths=count_5)
byGeometryColor = Modifiers.GeometryColor.ByGeometryColor(geometry=thicken, color=chop_4)

code_block_28 = CodeBlock { 1; }
getItemAtIndex_11 = List.GetItemAtIndex(list=watch@L2, index=code_block_28)
code_block_29 = CodeBlock { 1; }
getItemAtIndex_12 = List.GetItemAtIndex(list=watch, index=code_block_29)
importExcel_2 = Data.ImportExcel(file=file_from_path, sheetName=code_block_3.out0)
boolean_3 = BoolSelector(true)
read_excel = Custom[Read Excel](filePath=file_from_path, runIt=boolean_3, sheetName=code_block_3.out0)  # package BumbleBee; This node will read an excel file. You can read an entore sheet contents, read from specific origin cell, read only specific range, or do all of the former for multiple sheets at the same time.
watch_26 = Watch(read_excel)
