# Dynamo graph 0722 space planning test 001_mk.dyn (Dynamo 2.10.1.3976)
# packages: GenerativeDesign.Revit 1.7.3.0, GenerativeDesign 1.7.3.0, Clockwork for Dynamo 2.x 2.3.0, BumbleBee 2021.25.3

# group: User Inputs for GDIR
# note: Custom Package: GenerativeDesign v.2021.5.5
select_room_to_load_program_into = DSModelRoomSelection()  # 1 picked in the model; graph input

# group: Extract room boundary for DynaSpace and cache it in the graph
# note: Retrieve the room's finish boundary.
# Note: The first sublist is the outermost boundary of the room.
finishBoundary = Room.FinishBoundary(room=select_room_to_load_program_into)
# note: Custom Package: GenerativeDesign v.2021.5.5
remember = Data.Remember(finishBoundary)
firstItem = List.FirstItem(list=remember@L3)
startPoint = Curve.StartPoint(curve=firstItem)
flatten = List.Flatten(list=startPoint)
byJoinedCurves = PolyCurve.ByJoinedCurves(curves=firstItem)

# group: Display/Validation
the_outermost_room_boundary = Watch3D(byJoinedCurves)

# group: Excel Data import (package 정리 전)
file_path = Filename(".\space planning test 0715 001.xlsx")
file_from_path = FileObject(path=file_path)
code_block = CodeBlock { "Sheet1"; "SampleBuildingProgram-Clinic"; false; }
importExcel = Data.ImportExcel(file=file_from_path, sheetName=code_block.out1)
boolean = BoolSelector(true)
read_excel = Custom[Read Excel](filePath=file_from_path, runIt=boolean, sheetName=code_block.out0)  # package BumbleBee; This node will read an excel file. You can read an entore sheet contents, read from specific origin cell, read only specific range, or do all of the former for multiple sheets at the same time.
excel_data_정리_전 = Watch(read_excel)

# group: Excel List 분할
excel_data_정리_전_2 = Watch(excel_data_정리_전)
transpose = List.Transpose(lists=excel_data_정리_전_2)
remember_2 = Data.Remember(transpose)
code_block_2 = CodeBlock { 1; }
# note: List Name 정리
dropItems = List.DropItems(list=remember_2@L2, amount=code_block_2)
watch = Watch(dropItems)
code_block_3 = CodeBlock { 0; }
getItemAtIndex = List.GetItemAtIndex(list=watch, index=code_block_3)
space_id = Watch(getItemAtIndex)
code_block_4 = CodeBlock { 3; }
getItemAtIndex_2 = List.GetItemAtIndex(list=watch, index=code_block_4)
department_id = Watch(getItemAtIndex_2)
lastItem = List.LastItem(list=watch)
lev = Watch(lastItem)
code_block_5 = CodeBlock { 10; }
getItemAtIndex_3 = List.GetItemAtIndex(list=watch, index=code_block_5)
adjacent_spaces = Watch(getItemAtIndex_3)
code_block_6 = CodeBlock { 7; }
getItemAtIndex_4 = List.GetItemAtIndex(list=watch, index=code_block_6)
AREA = Watch(getItemAtIndex_4)
firstItem_2 = List.FirstItem(list=excel_data_정리_전_2)
list_이름_확인용 = Watch(firstItem_2)
code_block_7 = CodeBlock { 2; }
getItemAtIndex_5 = List.GetItemAtIndex(list=watch, index=code_block_7)
DEPARTMENT = Watch(getItemAtIndex_5)
code_block_8 = CodeBlock { 5; }
getItemAtIndex_6 = List.GetItemAtIndex(list=watch, index=code_block_8)
WIDTH = Watch(getItemAtIndex_6)

# group: Department 그룹
code_block_9 = CodeBlock { 2; }
getItemAtIndex_7 = List.GetItemAtIndex(list=watch, index=code_block_9)
watch_2 = Watch(getItemAtIndex_7)
uniqueItems = List.UniqueItems(list=watch_2)
eq = uniqueItems == watch_2  # lacing=CrossProduct

# group: 룸 BoundingBox 포인트 추출
byGeometry = BoundingBox.ByGeometry(geom=byJoinedCurves)
minPoint = BoundingBox.MinPoint(boundingBox=byGeometry)
X = Point.X(point=minPoint)
maxPoint = BoundingBox.MaxPoint(boundingBox=byGeometry)
X_2 = Point.X(point=maxPoint)
code_block_10 = CodeBlock { 1000; }
code_block_11 = CodeBlock(a=X, b=X_2, x=code_block_10) { a..b..x; }
Y = Point.Y(point=minPoint)
Y_2 = Point.Y(point=maxPoint)
code_block_12 = CodeBlock { 1000; }
code_block_13 = CodeBlock(a=Y, b=Y_2, x=code_block_12) { a..b..x; }
byCoordinates = Point.ByCoordinates(x=code_block_11, y=code_block_13, lacing=CrossProduct)
flatten_2 = List.Flatten(list=byCoordinates)
count = List.Count(list=flatten_2)

count_2 = List.Count(list=department_id)
code_block_14 = CodeBlock(a=count_2) { a-1; }
code_block_15 = CodeBlock(a=code_block_14) { 0..a..1; }

# group: 고정부/변동부 구별
department_id_2 = Watch(department_id)
# note: 3 = Path V = 계단
code_block_16 = CodeBlock { 3; }
eq_2 = department_id_2 == code_block_16
boolean_2 = BoolSelector(true)
allIndicesOf = List.AllIndicesOf(list=eq_2, item=boolean_2)
boolean_3 = BoolSelector(false)
allIndicesOf_2 = List.AllIndicesOf(list=eq_2, item=boolean_3)

# group: Level에 따라 Z 값 Dictionary 추출
lev_2 = Watch(lev)
uniqueItems_2 = List.UniqueItems(list=lev_2)
code_block_17 = CodeBlock { 0..4000..2000; }
byKeysValues = DesignScript.Builtin.Dictionary.ByKeysValues(keys=uniqueItems_2, values=code_block_17)
watch_3 = Watch(byKeysValues)
valueAtKey = DesignScript.Builtin.Dictionary.ValueAtKey(dictionary=watch_3, key=lev_2)
z_값_lev_에서_추출 = Watch(valueAtKey)

lev_3 = Watch(lev_2)

# group: 고정부 Seed
seed_고정부_코어 = DoubleSlider(572, range=0..999 step 1)  # graph input

# group: 층별 고정부 Index 추출
getItemAtIndex_8 = List.GetItemAtIndex(list=lev_3, index=allIndicesOf)
uniqueItems_3 = List.UniqueItems(list=getItemAtIndex_8)
eq_3 = uniqueItems_3 == getItemAtIndex_8  # lacing=CrossProduct
countTrue = List.CountTrue(list=eq_3@L2)
code_block_18 = CodeBlock { 0; }
watch_4 = Watch(count)
randomList = Math.RandomList(amount=countTrue, value1=code_block_18, value2=watch_4, seed=seed_고정부_코어)
watch_5 = Watch(randomList)
round = Math.Round(number=watch_5)

firstItem_3 = List.FirstItem(list=round)
replaceItemAtIndex = Custom[List.ReplaceItemAtIndex+](seq=code_block_15, indices=allIndicesOf, replacement=firstItem_3)  # package Clockwork for Dynamo 2.x; Replaces the item at a given index of a list by another item. Unlike the OOTB node, it can replace items at multiple indeces.

# group: 변동부 Seed
seed_변형부_공간 = DoubleSlider(842, range=0..999 step 1)  # graph input

# group: 층별 변동동부 Index 추출
getItemAtIndex_9 = List.GetItemAtIndex(list=lev_3, index=allIndicesOf_2)
uniqueItems_4 = List.UniqueItems(list=getItemAtIndex_9)
eq_4 = uniqueItems_4 == getItemAtIndex_9  # lacing=CrossProduct
countTrue_2 = List.CountTrue(list=eq_4@L2)
sum = Math.Sum(values=countTrue_2)
code_block_19 = CodeBlock { 0; }
watch_6 = Watch(count)
randomList_2 = Math.RandomList(amount=sum, value1=code_block_19, value2=watch_6, seed=seed_변형부_공간)
watch_7 = Watch(randomList_2)
round_2 = Math.Round(number=watch_7)

replaceItemAtIndex_2 = Custom[List.ReplaceItemAtIndex+](seq=replaceItemAtIndex, indices=allIndicesOf_2, replacement=round_2)

# group: Center Points
flatten_3 = List.Flatten(list=replaceItemAtIndex_2)
getItemAtIndex_10 = List.GetItemAtIndex(list=flatten_2, index=flatten_3)
X_3 = Point.X(point=getItemAtIndex_10)
Y_3 = Point.Y(point=getItemAtIndex_10)
byCoordinates_2 = Point.ByCoordinates(x=X_3, y=Y_3, z=z_값_lev_에서_추출, lacing=Shortest)

# group: Department로 List 분류
space_id_2 = Watch(space_id)
filterByBoolMask = List.FilterByBoolMask(list=space_id_2, mask=eq@L2)
watch_8 = Watch(filterByBoolMask.in)
filterByBoolMask_2 = List.FilterByBoolMask(list=byCoordinates_2, mask=eq@L2)
watch_9 = Watch(filterByBoolMask_2.in)
AREA_2 = Watch(AREA)
WIDTH_2 = Watch(WIDTH)

# group: Index - Point Dirctionary (삭제?)
flatten_4 = List.Flatten(list=watch_8)
watch_10 = Watch(flatten_4)
string_from_object = FromObject(object=watch_10)
flatten_5 = List.Flatten(list=watch_9)
watch_11 = Watch(flatten_5)
byKeysValues_2 = DesignScript.Builtin.Dictionary.ByKeysValues(keys=string_from_object, values=watch_11)
watch_12 = Watch(byKeysValues_2)
sort = List.Sort(list=flatten_4)
watch_13 = Watch(sort)
string_from_object_2 = FromObject(object=watch_13)
valueAtKey_2 = DesignScript.Builtin.Dictionary.ValueAtKey(dictionary=watch_12, key=string_from_object_2)

# group: 0~10 정배열 List Point 변경
X_4 = Point.X(point=valueAtKey_2)
Y_4 = Point.Y(point=valueAtKey_2)
z_값_lev_에서_추출_2 = Watch(z_값_lev_에서_추출)
byCoordinates_3 = Point.ByCoordinates(x=X_4, y=Y_4, z=z_값_lev_에서_추출_2)
정배열_points = Watch(byCoordinates_3)

# group: ADJACENT SPACES 연결을 위한 List 정리 / Line 추출
정배열_points_2 = Watch(정배열_points)
space_id_3 = Watch(space_id)
getItemAtIndex_11 = List.GetItemAtIndex(list=정배열_points_2, index=space_id_3)
watch_14 = Watch(adjacent_spaces)
string_from_object_3 = FromObject(object=watch_14)
watch_15 = Watch(string_from_object_3)
code_block_20 = CodeBlock { ".000000"; }
split = String.Split(str=watch_15@L1, separator0=code_block_20)
code_block_21 = CodeBlock { "."; }
split_2 = String.Split(str=split@L1, separator0=code_block_21)
toNumber = String.ToNumber(str=split_2)
flatten_6 = List.Flatten(list=toNumber)
string_from_object_4 = FromObject(object=flatten_6)
code_block_22 = CodeBlock { 1; }
code_block_23 = CodeBlock { 5; }
remove = String.Remove(string=string_from_object_4, startIndex=code_block_22, count=code_block_23)
watch_16 = Watch(remove)
isNull = Object.IsNull(object=watch_16)
boolean_4 = BoolSelector(false)
allIndicesOf_3 = List.AllIndicesOf(list=isNull, item=boolean_4)
watch_17 = Watch(allIndicesOf_3)
getItemAtIndex_12 = List.GetItemAtIndex(list=watch_16, index=watch_17)
replaceItemAtIndex_3 = Custom[List.ReplaceItemAtIndex+](seq=string_from_object_4, indices=watch_17, replacement=getItemAtIndex_12)
toNumber_2 = String.ToNumber(str=replaceItemAtIndex_3)
adjacent_spaces_flatten = Watch(toNumber_2)
getItemAtIndex_13 = List.GetItemAtIndex(list=정배열_points_2, index=adjacent_spaces_flatten)
count_3 = List.Count(list=toNumber@L2)
chop = List.Chop(list=getItemAtIndex_13, lengths=count_3)
byStartPointEndPoint = Line.ByStartPointEndPoint(startPoint=getItemAtIndex_11, endPoint=chop, lacing=Shortest)

code_block_24 = CodeBlock(a=AREA_2) { a/2; }

# group (continued): Department로 List 분류
filterByBoolMask_3 = List.FilterByBoolMask(list=code_block_24, mask=eq@L2)
watch_18 = Watch(filterByBoolMask_3.in)

# group: 버블 다이어그램용 원 (반지름 변경 전)
sqrt = Math.Sqrt(number=watch_18)
byCenterPointRadius = Circle.ByCenterPointRadius(centerPoint=watch_9, radius=sqrt)

# group: 부서별 Point 분류
getItemAtIndex_14 = List.GetItemAtIndex(list=정배열_points, index=watch_10)
count_4 = List.Count(list=watch_9@L2)
chop_2 = List.Chop(list=getItemAtIndex_14, lengths=count_4)

# group: REC (사각형) 변경 전
radius = Circle.Radius(circle=byCenterPointRadius)
code_block_25 = CodeBlock(a=radius) { a*2; }
byWidthLength = Rectangle.ByWidthLength(width=code_block_25, length=code_block_25)
X_5 = Point.X(point=chop_2)
Y_5 = Point.Y(point=chop_2)
Z = Point.Z(point=chop_2)
translate = Geometry.Translate(geometry=byWidthLength, xTranslation=X_5, yTranslation=Y_5, zTranslation=Z)
byPatch = Surface.ByPatch(closedCurve=translate)

# group: Lev 높이
code_block_26 = CodeBlock { 2000; }

# group: 부서별 색상 지정
watch_19 = Watch(watch_2)
uniqueItems_5 = List.UniqueItems(list=watch_19)
remember_3 = Data.Remember()  # unwired: arg0
remember_4 = Data.Remember()  # unwired: arg0
remember_5 = Data.Remember()  # unwired: arg0
remember_6 = Data.Remember()  # unwired: arg0
remember_7 = Data.Remember()  # unwired: arg0
remember_8 = Data.Remember()  # unwired: arg0
join = List.Join(list0=remember_3, list1=remember_4, list2=remember_5, list3=remember_6, list4=remember_7, list5=remember_8)
byKeysValues_3 = DesignScript.Builtin.Dictionary.ByKeysValues(keys=uniqueItems_5, values=join)
getItemAtIndex_15 = List.GetItemAtIndex(list=watch_19, index=flatten_4)

# group: 사각 공간 색상 지정
boolean_5 = BoolSelector(true)
thicken = Surface.Thicken(surface=byPatch, thickness=code_block_26, both_sides=boolean_5)
valueAtKey_3 = DesignScript.Builtin.Dictionary.ValueAtKey(dictionary=byKeysValues_3, key=getItemAtIndex_15)
count_5 = List.Count(list=thicken@L2)
chop_3 = List.Chop(list=valueAtKey_3, lengths=count_5)
byGeometryColor = Modifiers.GeometryColor.ByGeometryColor(geometry=thicken, color=chop_3)

# group: Read Excel
code_block_27 = CodeBlock { filePath: var = null; }
code_block_28 = CodeBlock { runIt: bool = false; }
code_block_29 = CodeBlock { sheetName: string = null; }
code_block_30 = CodeBlock { byColumn: bool = false; }
code_block_31 = CodeBlock { origin: string = null; }
code_block_32 = CodeBlock { extent: string = null; }
python_script = Python(IN[0]=code_block_27, IN[1]=code_block_28, IN[2]=code_block_29, IN[3]=code_block_30, IN[4]=code_block_31, IN[5]=code_block_32)  # IronPython2
# ---------- python_script.python (168 lines) ----------
# Copyright(c) 2016, David Mans, Konrad Sobon
# @arch_laboratory, http://archi-lab.net, http://neoarchaic.net

import clr
import sys
import System
from System import Array
from System.Collections.Generic import *

clr.AddReferenceByName('Microsoft.Office.Interop.Excel, Version=11.0.0.0, Culture=neutral, PublicKeyToken=71e9bce111e9429c')
from Microsoft.Office.Interop import Excel
System.Threading.Thread.CurrentThread.CurrentCulture = System.Globalization.CultureInfo("en-US")
from System.Runtime.InteropServices import Marshal

pyt_path = r'C:\Program Files (x86)\IronPython 2.7\Lib'
sys.path.append(pyt_path)

from os import path
assemblies = System.AppDomain.CurrentDomain.GetAssemblies()
path1 = [a.Location for a in assemblies if 'bumblebee,' in a.FullName][0]
path2 = System.IO.Path.GetDirectoryName(path1).rsplit('\\',1)[0]
bb_path = '%s\\extra\\' %path2
sys.path.append(bb_path)
import bumblebee as bb

#The inputs to this node will be stored as a list in the IN variable.
dataEnteringNode = IN

filePath = IN[0]
runMe = IN[1]
sheetName = IN[2]
byColumn = IN[3]
origin = IN[4]
extent = IN[5]

if filePath != None:
	if filePath.GetType() == System.IO.FileInfo:
		filePath = filePath.FullName

def ReadData(ws, origin, extent, byColumn):

	rng = ws.Range[origin, extent].Value2
	if not byColumn:
		dataOut = [[] for i in range(rng.GetUpperBound(0))]
		for i in range(rng.GetLowerBound(0)-1, rng.GetUpperBound(0), 1):
			for j in range(rng.GetLowerBound(1)-1, rng.GetUpperBound(1), 1):
				dataOut[i].append(rng[i,j])
		return dataOut
	else:
		dataOut = [[] for i in range(rng.GetUpperBound(1))]
		for i in range(rng.GetLowerBound(1)-1, rng.GetUpperBound(1), 1):
			for j in range(rng.GetLowerBound(0)-1, rng.GetUpperBound(0), 1):
				dataOut[i].append(rng[j,i])
		return dataOut

def GetOrigin(ws, origin):
	if origin != None:
		origin = ws.Cells(bb.CellIndex(origin)[1], bb.CellIndex(origin)[0])
	else:
		origin = ws.Cells(ws.UsedRange.Row, ws.UsedRange.Column)
	return origin

def GetExtent(ws, extent):
	if extent != None:
		extent = ws.Cells(bb.CellIndex(extent)[1], bb.CellIndex(extent)[0])
	else:
		extent = ws.Cells(ws.UsedRange.Rows(ws.UsedRange.Rows.Count).Row, ws.UsedRange.Columns(ws.UsedRange.Columns.Count).Column)
	return extent

def SetUp(xlApp):
	# supress updates and warning pop ups
	xlApp.Visible = False
	xlApp.DisplayAlerts = False
	xlApp.ScreenUpdating = False
	return xlApp

def ExitExcel(xlApp, wb, ws):
	# clean up before exiting excel, if any COM object remains
	# unreleased then excel crashes on open following time
	def CleanUp(_list):
		if isinstance(_list, list):
			for i in _list:
				Marshal.ReleaseComObject(i)
		else:
			Marshal.ReleaseComObject(_list)
		return None
		
	xlApp.ActiveWorkbook.Close(False)
	xlApp.ScreenUpdating = True
	CleanUp([ws,wb,xlApp])
	return None

def LiveStream():
	try:
		xlApp = Marshal.GetActiveObject("Excel.Application")
		xlApp.Visible = True
		xlApp.DisplayAlerts = False
		return xlApp
	except:
		return None

live = False

if runMe:
	try:
		errorReport = None
		message = None
		if filePath == None:
			# run excel in live mode
			xlApp = LiveStream()
			live = True
		else:
			# run excel from file on disk
			xlApp = SetUp(Excel.ApplicationClass())
			if path.isfile(unicode(filePath)):
				xlApp.Workbooks.open(unicode(filePath))
			live = False				
		# get workbook
		wb = xlApp.ActiveWorkbook
		# get worksheet
		if sheetName == None:
			ws = xlApp.ActiveSheet
			dataOut = ReadData(ws, GetOrigin(ws, origin), GetExtent(ws, extent), byColumn)
			if not live:
				ExitExcel(xlApp, wb, ws)
		elif not isinstance(sheetName, list):
			ws = xlApp.Sheets(sheetName)
			dataOut = ReadData(ws, GetOrigin(ws, origin), GetExtent(ws, extent), byColumn)
			if not live:
				ExitExcel(xlApp, wb, ws)
		else:
			# process multiple sheets
			dataOut = []
			if isinstance(origin, list):
				if isinstance(extent, list):
					for index, (name, oValue, eValue) in enumerate(zip(sheetName, origin, extent)):
						ws = xlApp.Sheets(str(name))
						dataOut.append(ReadData(ws, GetOrigin(ws, oValue), GetExtent(ws, eValue), byColumn))
				else:
					for index, (name, oValue) in enumerate(zip(sheetName, origin)):
						ws = xlApp.Sheets(str(name))
						dataOut.append(ReadData(ws, GetOrigin(ws, oValue), GetExtent(ws, extent), byColumn))
			else:
				if isinstance(extent, list):
					for index, (name, eValue) in enumerate(zip(sheetName, extent)):
						ws = xlApp.Sheets(str(name))
						dataOut.append(ReadData(ws, GetOrigin(ws, origin), GetExtent(ws, eValue), byColumn))
				else:
					for index, name in enumerate(sheetName):
						ws = xlApp.Sheets(str(name))
						dataOut.append(ReadData(ws, GetOrigin(ws, origin), GetExtent(ws, extent), byColumn))
			if not live:
				ExitExcel(xlApp, wb, ws)	
	except:
		xlApp.Quit()
		Marshal.ReleaseComObject(xlApp)
		# if error accurs anywhere in the process catch it
		import traceback
		errorReport = traceback.format_exc()
		pass
else:
	errorReport = "Set RunMe to True."

#Assign your output to the OUT variable
if errorReport == None:
	OUT = dataOut
else:
	OUT = errorReport
# ----------------------------------------
code_block_33 = CodeBlock(OUT=python_script) { OUT; }

# group: 삭제 예정
code_block_34 = CodeBlock {  }
code_block_35 = CodeBlock {  }

point_index_list_추출 = Watch(replaceItemAtIndex_2)
