# Dynamo graph Stairs_DataStructureTest(0729).dyn (Dynamo 2.10.1.3976)

join = List.Join()  # unwired: list0

# group: Primary Input
categories = Categories("OST_Stairs")
all_elements_of_category = ElementsOfCategory(Category=categories)
file_path = Filename(".\BIM_물량집계 자동화 산출기준표_rC(20210729).xlsx")
file_from_path = FileObject(path=file_path)
code_block = CodeBlock { "Doors"; }

# group: GetFull WMCodeDescription PerElement
getFullWMCodeDescriptionPerElement = Custom[GetFullWMCodeDescriptionPerElement](InputElement=all_elements_of_category, InputFilePath=file_from_path, InputSheetName=code_block)  # GetFullWMCodeDescriptionPerElement

# group: OrganizeAllElementInformAsDictionary
organizeAllElementInformAsDictionary = Custom[OrganizeAllElementInformAsDictionary](InputDic=getFullWMCodeDescriptionPerElement.Dictionary)  # OrganizeAllElementInformAsDictionary

# group: Select Target Family Element And Connected WorkMasters
code_block_2 = CodeBlock { 0; }
selectTargetFamilyInformAsDictionary = Custom[SelectTargetFamilyInformAsDictionary](InputDic=organizeAllElementInformAsDictionary, InputIndex=code_block_2)  # Select Target Family Element And Connected WorkMasters

watch = Watch(selectTargetFamilyInformAsDictionary)
code_block_3 = CodeBlock(i=watch) { i; }

# group: TargetWMunique + Data Sending
code_block_4 = CodeBlock(InputDic2=join) { _InputDic2; }
count = List.Count(list=code_block_4)
code_block_5 = CodeBlock(InputDic1=code_block_3) { _InputDic1; }
code_block_6 = CodeBlock { "TargetWMunique"; }
valueAtKey = DesignScript.Builtin.Dictionary.ValueAtKey(dictionary=code_block_5, key=code_block_6)
watch_2 = Watch(valueAtKey)
count_2 = List.Count(list=watch_2)
eq = count == count_2
organizeFuncValuesAndWorkMasterAsDiction = Custom[OrganizeFuncValuesAndWorkMasterAsDictionary](InputDic1=code_block_5, InputDic2=code_block_4)  # Organize FuncValues and WorkMaster As Dictionary
watch_3 = Watch()  # unwired: arg0
if_ = If(test=eq, true=organizeFuncValuesAndWorkMasterAsDiction, false=watch_3)

# group: 데이터 취합 및 Row 방향 정렬
code_block_7 = CodeBlock(InputDic=if_) { _InputDic; }
code_block_8 = CodeBlock { "TrTargetFamilyCode"; }
valueAtKey_2 = DesignScript.Builtin.Dictionary.ValueAtKey(dictionary=code_block_7, key=code_block_8)
watch_4 = Watch(valueAtKey_2)
flatten = List.Flatten(list=watch_4)
code_block_9 = CodeBlock { "WMforTargetElements"; }
valueAtKey_3 = DesignScript.Builtin.Dictionary.ValueAtKey(dictionary=code_block_7, key=code_block_9)
watch_5 = Watch(valueAtKey_3)
flatten_2 = List.Flatten(list=watch_5)
code_block_10 = CodeBlock { "TargetFuncValues"; }
valueAtKey_4 = DesignScript.Builtin.Dictionary.ValueAtKey(dictionary=code_block_7, key=code_block_10)
watch_6 = Watch(valueAtKey_4)
flatten_3 = List.Flatten(list=watch_6)
code_block_11 = CodeBlock { "TargetFuncValuesUnit"; }
valueAtKey_5 = DesignScript.Builtin.Dictionary.ValueAtKey(dictionary=code_block_7, key=code_block_11)
watch_7 = Watch(valueAtKey_5)
flatten_4 = List.Flatten(list=watch_7)
list_create = List.Create(item0=flatten, item1=flatten_2, item2=flatten_3, item3=flatten_4)
transpose = List.Transpose(lists=list_create)

# group: 패밀리 별 취합 + Export Excel(By OpenpyXl)
# note: Excel Export Button
boolean = BoolSelector(true)
join_2 = List.Join(list0=transpose)
watch_8 = Watch()  # unwired: arg0
if_2 = If(test=boolean, true=join_2, false=watch_8)
python_script_export_excel_by = Python(IN[0]=if_2)  # "Python Script@Export Excel(By OpenpyXl)"; CPython3
# ---------- python_script_export_excel_by.python (151 lines) ----------
# Load the Python Standard and DesignScript Libraries
import sys
import os
#sys.path.append(r'C:\Users\HEC\AppData\Local\Programs\Python\Python39\Lib\site-packages')
#sys.path.append(r'C:\Users\pjmk0\AppData\Local\Programs\Python\Python39\Lib\site-packages')
sys.path.append(os.getenv('LOCALAPPDATA').replace('\\','\\\\') + r'\Programs\Python\Python39\Lib\site-packages')
import clr
clr.AddReference('ProtoGeometry')
from Autodesk.DesignScript.Geometry import *
from collections import Iterable

def iterable(obj):
    return isinstance(obj, Iterable)


# The inputs to this node will be stored as a list in the IN variables.
dataEnteringNode = IN
ListIn = IN[0]

# Place your code below this line
import datetime
from datetime import date, timedelta
Today = date.today()
import openpyxl
from openpyxl.styles import Border, Side, PatternFill, Font, GradientFill, Alignment, Color, numbers

sample_items = ListIn


def write_to_file(filepath):
    wb = openpyxl.Workbook()
    for sheet in wb.sheetnames:
        wb.remove(wb[sheet])

    thin = Side(border_style="thin", color="000000")
    double = Side(border_style="double", color="000000")

    ws = wb.create_sheet(title='Wall_Calc_instance', index=0)

    ws.merge_cells('A1:L1')
    ws['A1'] = 'HEC Wall Category Calculation Sheet'
    cell = ws['A1']
    cell.font = openpyxl.styles.Font(color='000000', size=20)
    cell.fill = openpyxl.styles.fills.PatternFill(patternType='solid',
                                                  fgColor=openpyxl.styles.colors.Color(rgb='fff3b0'))

    ws['A2'] = 'Item Number'
    ws['A2'].font = openpyxl.styles.Font(b=True, color='000000', size=12)
    #ws['B2'] = 'Member Name'
    #ws['B2'].font = openpyxl.styles.Font(b=True, color='000000', size=12)
    #ws['C2'] = 'Category'
    #ws['C2'].font = openpyxl.styles.Font(b=True, color='000000', size=12)
    ws['B2'] = 'Family Type'
    ws['B2'].font = openpyxl.styles.Font(b=True, color='000000', size=12)
    ws['C2'] = 'WorkMaster Code'
    ws['C2'].font = openpyxl.styles.Font(b=True, color='000000', size=12)
    #ws['F2'] = 'WorkMaster Description'
    #ws['F2'].font = openpyxl.styles.Font(b=True, color='000000', size=12)
    #ws['G2'] = 'Unit'
    #ws['G2'].font = openpyxl.styles.Font(b=True, color='000000', size=12)
    #ws['H2'] = '계수'
    #ws['H2'].font = openpyxl.styles.Font(b=True, color='000000', size=12)
    #ws['I2'] = '계산 참조값'
    #ws['I2'].font = openpyxl.styles.Font(b=True, color='000000', size=12)
    ws['D2'] = 'Quantities'
    ws['D2'].font = openpyxl.styles.Font(b=True, color='000000', size=12)
    ws['E2'] = 'Unit'
    ws['E2'].font = openpyxl.styles.Font(b=True, color='000000', size=12)
    ws['F2'] = 'Unit Price'
    ws['F2'].font = openpyxl.styles.Font(b=True, color='000000', size=12)
    ws['G2'] = 'Total Price'
    ws['G2'].font = openpyxl.styles.Font(b=True, color='000000', size=12)


## 칼럼별 너비 조정 구간
#    for col in range(ws.max_column):
#        ws.column_dimensions[chr(ord('A') + col)].width = 15
    ws.column_dimensions['A'].width = 15
    ws.column_dimensions['B'].width = 45
    ws.column_dimensions['C'].width = 60
    ws.column_dimensions['D'].width = 20
    ws.column_dimensions['E'].width = 20
    ws.column_dimensions['F'].width = 20
    ws.column_dimensions['G'].width = 20
    #ws.column_dimensions['G'].width = 9
    #ws.column_dimensions['H'].width = 9
    #ws.column_dimensions['H'].hidden = True
    #ws.column_dimensions['I'].width = 12
    #ws.column_dimensions['I'].hidden = True
    #ws.column_dimensions['J'].width = 12
    #ws.column_dimensions['K'].width = 12
    #ws.column_dimensions['L'].width = 12

###
    start_row = 3
    for (row, item) in enumerate(sample_items, start_row):
        cell = ws.cell(row=row, column=1, value=row - 2)
        cell.alignment = openpyxl.styles.Alignment(horizontal='center', vertical='center')

#        cell = ws.cell(row=row, column=2, value=item[0])
#        cell.number_format = openpyxl.styles.numbers.FORMAT_DATE_YYYYMMDD2  # 'yyyy-mm-dd'
        ws.cell(row=row, column=2, value=item[0]) ## Family Type 칼럼

        ws.cell(row=row, column=3, value=item[1]) ## WorkMaster Code 칼럼
        
        ws.cell(row=row, column=4, value=item[2]) ## Quantities 칼럼
        
        ws.cell(row=row, column=5, value=item[3]) ## Unit 칼럼
        
        #cell = ws.cell(row=row, column=8, value=item[6]) ## 계수 칼럼
        #cell.number_format = openpyxl.styles.numbers.builtin_format_code(3)  # '#,##0'
        
        #cell = ws.cell(row=row, column=9, value=item[7]) ## 계산 참조값 칼럼
        #cell.number_format = openpyxl.styles.numbers.builtin_format_code(3)  # '#,##0'
        
        #cell = ws.cell(row=row, column=10, value=item[8]) ## Quantities 칼럼
        #cell.number_format = openpyxl.styles.numbers.builtin_format_code(3)  # '#,##0'
        #cell.font = openpyxl.styles.Font(b=True, color='000000', size=11)

        cell = ws.cell(row=row, column=7, value='= D{current_row}*F{current_row}'.format(current_row=cell.row))
        cell.number_format = '#,##0'

#        cell = ws.cell(row=row, column=6, value='= D{current_row} * E{current_row}'.format(current_row=cell.row))
#        cell.number_format = openpyxl.styles.numbers.builtin_format_code(3)

    total_row = ws.max_row + 1
    if total_row > start_row:
        cell1 = ws.cell(row=total_row, column=6, value='Total')
        cell1.font = openpyxl.styles.Font(b=True, color='000000', size=15)
        
        cell2 = ws.cell(row=total_row, column=7, value='= SUM(G{}:G{})'.format(start_row, total_row - 1))
        cell2.number_format = openpyxl.styles.numbers.builtin_format_code(3)
        cell2.border = Border(top=double, left=double, right=double, bottom=double)
        cell2.font = openpyxl.styles.Font(b=True, color='ff03ce', size=15)
    

    wb.save(filepath)
    wb.close()


##if __name__ == '__main__':
#write_to_file('C:\\Users\\pjmk0\\AppData\\Roaming\\test.xlsx')

save_name = "HecStrFDNCalcSheet_" + Today.strftime("%Y-%m-%d")+".xlsx"
path = os.getenv('APPDATA').replace('\\','\\\\')
filePath = path + '\\' + save_name

write_to_file(filePath)

# Assign your output to the OUT variable.
OUT = os.getenv('APPDATA')
# ----------------------------------------

# group: <Func 1> 콘크리트 체적
code_block_12 = CodeBlock { "TargetElements"; }
valueAtKey_6 = DesignScript.Builtin.Dictionary.ValueAtKey(dictionary=code_block_3, key=code_block_12)
# note: <Func>
geometry = Element.Geometry(element=valueAtKey_6)
flatten_5 = List.Flatten(list=geometry@L2)
volume = Solid.Volume(solid=flatten_5)
flatten_6 = List.Flatten(list=volume)
sum = Math.Sum(values=flatten_6)
code_block_13 = CodeBlock(i=sum) { Math.Round(List.Flatten(i)/1000000000, 2); }
code_block_14 = CodeBlock { "M3"; }
count_3 = List.Count(list=code_block_13)
ofRepeatedItem = List.OfRepeatedItem(item=code_block_14, amount=count_3)
code_block_15 = CodeBlock(FuncValues=code_block_13, FuncValuesUnit=ofRepeatedItem)
# ---------- code_block_15.designscript (4 lines) ----------
{
"FuncValues": _FuncValues,
"FuncValuesUnit": _FuncValuesUnit
};
# ----------------------------------------

watch_9 = Watch(code_block_15)

# group: <Func 2> 하부/측면/Riser 면적산출
code_block_16 = CodeBlock { "TargetElements"; }
valueAtKey_7 = DesignScript.Builtin.Dictionary.ValueAtKey(dictionary=code_block_3, key=code_block_16)
geometry_2 = Element.Geometry(element=valueAtKey_7)
explode = Geometry.Explode(geometry=geometry_2)
flatten_7 = List.Flatten(list=explode)
# note: <Func>
extractUpperFacesOfElement = Custom[ExtractUpperFacesOfElement](Element=valueAtKey_7)  # ExtractUpperFacesOfElement
flatten_8 = List.Flatten(list=extractUpperFacesOfElement.Surface)
byJoinedSurfaces = PolySurface.ByJoinedSurfaces(surfaces=flatten_8)
doesIntersect = Geometry.DoesIntersect(geometry=byJoinedSurfaces, other=flatten_7, lacing=CrossProduct)
filterByBoolMask = List.FilterByBoolMask(list=flatten_7, mask=doesIntersect@L2)
code_block_17 = CodeBlock { "M2"; }

extractSideFacesOfElement = Custom[ExtractSideFacesOfElement](Element=valueAtKey_7)  # ExtractSideFacesOfElement
list_create_2 = List.Create(item0=extractSideFacesOfElement.Surface, item1=filterByBoolMask.out)
flatten_9 = List.Flatten(list=list_create_2)

# group (continued): <Func 2> 하부/측면/Riser 면적산출
area = Surface.Area(surface=flatten_9)
sum_2 = Math.Sum(values=area)
code_block_18 = CodeBlock(i=sum_2) { Math.Round(List.Flatten(i)/1000000, 2); }
count_4 = List.Count(list=code_block_18)
ofRepeatedItem_2 = List.OfRepeatedItem(item=code_block_17, amount=count_4)
code_block_19 = CodeBlock(FuncValues=code_block_18, FuncValuesUnit=ofRepeatedItem_2)  # same code as code_block_15

watch_10 = Watch(code_block_19)

# group: <Func 3> 콘크리트 체적 선택
code_block_20 = CodeBlock { "TargetElements"; }
valueAtKey_8 = DesignScript.Builtin.Dictionary.ValueAtKey(dictionary=code_block_3, key=code_block_20)
# note: <Func>
geometry_3 = Element.Geometry(element=valueAtKey_8)
flatten_10 = List.Flatten(list=geometry_3@L2)
volume_2 = Solid.Volume(solid=flatten_10)
flatten_11 = List.Flatten(list=volume_2)
sum_3 = Math.Sum(values=flatten_11)
# note: 비율 추가
code_block_21 = CodeBlock(i=sum_3) { Math.Round(List.Flatten(i)/1000000000, 2); }
code_block_22 = CodeBlock { "M3"; }
count_5 = List.Count(list=code_block_21)
ofRepeatedItem_3 = List.OfRepeatedItem(item=code_block_22, amount=count_5)
code_block_23 = CodeBlock(FuncValues=code_block_21, FuncValuesUnit=ofRepeatedItem_3)  # same code as code_block_15

watch_11 = Watch(code_block_23)

# group: <Func 4> 계단 하부노출면
code_block_24 = CodeBlock { "TargetElements"; }
valueAtKey_9 = DesignScript.Builtin.Dictionary.ValueAtKey(dictionary=code_block_3, key=code_block_24)
geometry_4 = Element.Geometry(element=valueAtKey_9)
explode_2 = Geometry.Explode(geometry=geometry_4)
flatten_12 = List.Flatten(list=explode_2)
# note: <Func>
extractUpperFacesOfElement_2 = Custom[ExtractUpperFacesOfElement](Element=valueAtKey_9)
flatten_13 = List.Flatten(list=extractUpperFacesOfElement_2.Surface)
byJoinedSurfaces_2 = PolySurface.ByJoinedSurfaces(surfaces=flatten_13)
doesIntersect_2 = Geometry.DoesIntersect(geometry=byJoinedSurfaces_2, other=flatten_12, lacing=CrossProduct)
filterByBoolMask_2 = List.FilterByBoolMask(list=flatten_12, mask=doesIntersect_2@L2)
flatten_14 = List.Flatten(list=filterByBoolMask_2.out)
area_2 = Surface.Area(surface=flatten_14)
sum_4 = Math.Sum(values=area_2)
code_block_25 = CodeBlock(i=sum_4) { Math.Round(List.Flatten(i)/1000000, 2); }
code_block_26 = CodeBlock { "M2"; }
count_6 = List.Count(list=code_block_25)
ofRepeatedItem_4 = List.OfRepeatedItem(item=code_block_26, amount=count_6)
code_block_27 = CodeBlock(FuncValues=code_block_25, FuncValuesUnit=ofRepeatedItem_4)  # same code as code_block_15

watch_12 = Watch(code_block_27)

# group: <Func 5> 계단 상부노출면
code_block_28 = CodeBlock { "TargetElements"; }
valueAtKey_10 = DesignScript.Builtin.Dictionary.ValueAtKey(dictionary=code_block_3, key=code_block_28)
# note: <Func>
extractUpperFacesOfElement_3 = Custom[ExtractUpperFacesOfElement](Element=valueAtKey_10)
flatten_15 = List.Flatten(list=extractUpperFacesOfElement_3.Surface)
area_3 = Surface.Area(surface=flatten_15)
sum_5 = Math.Sum(values=area_3)
code_block_29 = CodeBlock(i=sum_5) { Math.Round(List.Flatten(i)/1000000, 2); }
code_block_30 = CodeBlock { "M2"; }
count_7 = List.Count(list=code_block_29)
ofRepeatedItem_5 = List.OfRepeatedItem(item=code_block_30, amount=count_7)
code_block_31 = CodeBlock(FuncValues=code_block_29, FuncValuesUnit=ofRepeatedItem_5)  # same code as code_block_15

watch_13 = Watch(code_block_31)

# group: <Func 6,8> 계단과 벽체가 만나는 지점에서 Nosing을 잇는 선을 100mm offset하고 그 경계 하부 면적을 계산
area_4 = Surface.Area()  # unwired: surface
sum_6 = Math.Sum(values=area_4)
code_block_32 = CodeBlock(i=sum_6) { Math.Round(List.Flatten(i)/1000000, 2); }
code_block_33 = CodeBlock { "M2"; }
count_8 = List.Count(list=code_block_32)
ofRepeatedItem_6 = List.OfRepeatedItem(item=code_block_33, amount=count_8)
code_block_34 = CodeBlock(FuncValues=code_block_32, FuncValuesUnit=ofRepeatedItem_6)  # same code as code_block_15
# note: <Func>
code_block_35 = CodeBlock { "TargetElements"; }
valueAtKey_11 = DesignScript.Builtin.Dictionary.ValueAtKey(dictionary=code_block_3, key=code_block_35)

watch_14 = Watch(code_block_34)
geometry_5 = Element.Geometry(element=valueAtKey_11)
explode_3 = Geometry.Explode(geometry=geometry_5)
flatten_16 = List.Flatten(list=explode_3)
# note: <Func>
extractUpperFacesOfElement_4 = Custom[ExtractUpperFacesOfElement](Element=valueAtKey_11)
flatten_17 = List.Flatten(list=extractUpperFacesOfElement_4.Surface)
byJoinedSurfaces_3 = PolySurface.ByJoinedSurfaces(surfaces=flatten_17)
doesIntersect_3 = Geometry.DoesIntersect(geometry=byJoinedSurfaces_3, other=flatten_16, lacing=CrossProduct)
filterByBoolMask_3 = List.FilterByBoolMask(list=flatten_16, mask=doesIntersect_3@L2)
perimeterCurves = Surface.PerimeterCurves(surface=filterByBoolMask_3.out@L1)
startPoint = Curve.StartPoint(curve=perimeterCurves)
boolean_2 = BoolSelector(true)
byPoints = PolyCurve.ByPoints(points=startPoint, connectLastToFirst=boolean_2)
flatten_18 = List.Flatten(list=filterByBoolMask_3.out)
code_block_36 = CodeBlock { 450; }
translate = Geometry.Translate(geometry=flatten_18, zTranslation=code_block_36)
perimeterCurves_2 = Surface.PerimeterCurves(surface=translate)
startPoint_2 = Curve.StartPoint(curve=perimeterCurves_2)
boolean_3 = BoolSelector(true)
byPoints_2 = PolyCurve.ByPoints(points=startPoint_2, connectLastToFirst=boolean_3)
list_create_3 = List.Create(item0=byPoints, item1=byPoints_2)
transpose_2 = List.Transpose(lists=list_create_3)
byLoft = Solid.ByLoft(crossSections=transpose_2)
isNull = Object.IsNull(object=byLoft)
filterByBoolMask_4 = List.FilterByBoolMask(list=byLoft, mask=isNull)
byUnion = Solid.ByUnion(solids=filterByBoolMask_4.out)
geometry_6 = Element.Geometry(element=valueAtKey_11)
flatten_19 = List.Flatten(list=geometry_6)
byUnion_2 = Solid.ByUnion(solids=flatten_19)
differenceAll = Solid.DifferenceAll(solid=byUnion, others=byUnion_2)
explode_4 = Geometry.Explode(geometry=differenceAll)
code_block_37 = CodeBlock { 0.5; }
normalAtParameter = Surface.NormalAtParameter(surface=explode_4, u=code_block_37, v=code_block_37)

# group: func2 (ExtractSideFacesOfElement)
Z = Vector.Z(vector=normalAtParameter)
code_block_38 = CodeBlock { 0; }
round = Math.Round(number=Z, digits=code_block_38)
code_block_39 = CodeBlock(i=round) { i<1 && i>-1; }
filterByBoolMask_5 = List.FilterByBoolMask(list=explode_4, mask=code_block_39)
color_palette = ColorPalette({R: 255, G: 0, B: 255, A: 136})
byGeometryColor = Modifiers.GeometryColor.ByGeometryColor(geometry=filterByBoolMask_5.in, color=color_palette)
code_block_40 = CodeBlock { Surface; }
code_block_41 = CodeBlock { GeometryColor; }

byStartPointEndPoint = Line.ByStartPointEndPoint()  # unwired: startPoint, endPoint
Z_2 = Point.Z()  # unwired: point
sort = List.Sort(list=Z_2)
watch_15 = Watch(filterByBoolMask_5.in)
separate = Solid.Separate(solid=differenceAll)
doesIntersect_4 = Geometry.DoesIntersect(geometry=separate, other=watch_15, lacing=CrossProduct)
filterByBoolMask_6 = List.FilterByBoolMask(list=watch_15, mask=doesIntersect_4@L2)
watch_16 = Watch(filterByBoolMask_6.in)
watch_17 = Watch(filterByBoolMask_5.out)
separate_2 = Solid.Separate(solid=differenceAll)
doesIntersect_5 = Geometry.DoesIntersect(geometry=separate_2, other=watch_17, lacing=CrossProduct)
filterByBoolMask_7 = List.FilterByBoolMask(list=watch_17, mask=doesIntersect_5@L2)
watch_18 = Watch(filterByBoolMask_7.in)
area_5 = Surface.Area(surface=watch_18)
code_block_42 = CodeBlock { 0; }
round_2 = Math.Round(number=area_5, digits=code_block_42)
area_6 = Surface.Area()  # unwired: surface
minimumItemByKey = List.MinimumItemByKey(list=watch_18@L2, keyFunction=area_6)
watch_19 = Watch(minimumItemByKey)
area_7 = Surface.Area(surface=watch_19)
code_block_43 = CodeBlock { 0; }
round_3 = Math.Round(number=area_7, digits=code_block_43)
eq_2 = round_2@L2 == round_3@L1  # lacing=Shortest
filterByBoolMask_8 = List.FilterByBoolMask(list=watch_18@L2, mask=eq_2@L2)
flatten_20 = List.Flatten(list=filterByBoolMask_8.in)
flatten_21 = List.Flatten(list=flatten_20)
countTrue = List.CountTrue(list=eq_2@L2)
code_block_44 = CodeBlock(a=countTrue) { a/2; }
code_block_45 = CodeBlock { 2; }
ofRepeatedItem_7 = List.OfRepeatedItem(item=code_block_44, amount=code_block_45)
transpose_3 = List.Transpose(lists=ofRepeatedItem_7)
flatten_22 = List.Flatten(list=transpose_3)
chop = List.Chop(list=flatten_21, lengths=flatten_22)
code_block_46 = CodeBlock { 0.5; }
pointAtParameter = Surface.PointAtParameter(surface=chop, u=code_block_46, v=code_block_46)
byPoints_3 = PolyCurve.ByPoints(points=pointAtParameter)
code_block_47 = CodeBlock { 200; }
extendStart = Curve.ExtendStart(curve=byPoints_3, distance=code_block_47)
startPoint_3 = Curve.StartPoint(curve=extendStart)
code_block_48 = CodeBlock { 2; }
chop_2 = List.Chop(list=startPoint_3, lengths=code_block_48)
extendEnd = Curve.ExtendEnd(curve=byPoints_3, distance=code_block_47)
endPoint = Curve.EndPoint(curve=extendEnd)
code_block_49 = CodeBlock { 2; }
chop_3 = List.Chop(list=endPoint, lengths=code_block_49)
addItemToFront = List.AddItemToFront(item=chop_2@L2, list=chop_3@L2)
flatten_23 = List.Flatten(list=addItemToFront@L3)
sortByFunction = List.SortByFunction(list=flatten_23@L2, sortFunction=Z_2)
byPoints_4 = PolyCurve.ByPoints(points=sortByFunction)
doesIntersect_6 = Geometry.DoesIntersect(geometry=watch_16@L2, other=byPoints_4@L1)
filterByBoolMask_9 = List.FilterByBoolMask(list=watch_16, mask=doesIntersect_6)
watch_20 = Watch(filterByBoolMask_9.out)
code_block_50 = CodeBlock { 1200; }
translate_2 = Geometry.Translate(geometry=byPoints_4, zTranslation=code_block_50)
list_create_4 = List.Create(item0=byPoints_4, item1=translate_2)
transpose_4 = List.Transpose(lists=list_create_4)
byLoft_2 = Surface.ByLoft(crossSections=transpose_4)
code_block_51 = CodeBlock { 300; }
thicken = Surface.Thicken(surface=byLoft_2, thickness=code_block_51)
doesIntersect_7 = Geometry.DoesIntersect(geometry=watch_20@L2, other=thicken@L1)
filterByBoolMask_10 = List.FilterByBoolMask(list=watch_20, mask=doesIntersect_7)
flatten_24 = List.Flatten(list=filterByBoolMask_10.out)

# group: <Func 7,9,10> 계단 상부노출면 + Riser 노출면
code_block_52 = CodeBlock { "TargetElements"; }
valueAtKey_12 = DesignScript.Builtin.Dictionary.ValueAtKey(dictionary=code_block_3, key=code_block_52)
# note: <Func>
extractUpperFacesOfElement_5 = Custom[ExtractUpperFacesOfElement](Element=valueAtKey_12)
flatten_25 = List.Flatten(list=extractUpperFacesOfElement_5.Surface)
flatten_26 = List.Flatten(list=filterByBoolMask_9.in)
list_create_5 = List.Create(item0=flatten_25, item1=flatten_26)
flatten_27 = List.Flatten(list=list_create_5)
area_8 = Surface.Area(surface=flatten_27)
sum_7 = Math.Sum(values=area_8)
code_block_53 = CodeBlock(i=sum_7) { Math.Round(List.Flatten(i)/1000000, 2); }
code_block_54 = CodeBlock { "M2"; }
count_9 = List.Count(list=code_block_53)
ofRepeatedItem_8 = List.OfRepeatedItem(item=code_block_54, amount=count_9)
code_block_55 = CodeBlock(FuncValues=code_block_53, FuncValuesUnit=ofRepeatedItem_8)  # same code as code_block_15
watch_21 = Watch(code_block_55)
