# Dynamo graph test 0727.dyn (Dynamo 2.10.1.3976)

number_slider = DoubleSlider(4.246, range=0..100 step 0.1)
number_slider_2 = DoubleSlider(18.862, range=0..100 step 0.1)
number_slider_3 = DoubleSlider(0, range=0..100 step 0.1)
byCoordinates = Point.ByCoordinates(x=number_slider, y=number_slider_2, z=number_slider_3)
byCoordinates_2 = Point.ByCoordinates()
number_slider_4 = DoubleSlider(3.416, range=0..100 step 0.1)
number_slider_5 = DoubleSlider(-7.34, range=-7.34..100 step 0.1)
byCoordinates_3 = Point.ByCoordinates(x=number_slider_4, y=number_slider_5)
number_slider_6 = DoubleSlider(12.725, range=0..100 step 0.1)
number_slider_7 = DoubleSlider(-2.99, range=-2.99..100 step 0.1)
byCoordinates_4 = Point.ByCoordinates(x=number_slider_6, y=number_slider_7)
number_slider_8 = DoubleSlider(19.698, range=0..100 step 0.1)
number_slider_9 = DoubleSlider(11.536, range=0..100 step 0.1)
byCoordinates_5 = Point.ByCoordinates(x=number_slider_8, y=number_slider_9)
list_create = List.Create(item0=byCoordinates, item1=byCoordinates_2, item2=byCoordinates_3, item3=byCoordinates_4, item4=byCoordinates_5)
flatten = List.Flatten(list=list_create)
code_block = CodeBlock { 2; 4; 5; 3; 3; }
list_create_2 = List.Create(item0=code_block.out0, item1=code_block.out1, item2=code_block.out2, item3=code_block.out3, item4=code_block.out4)
flatten_2 = List.Flatten(list=list_create_2)
byCenterPointRadius = Circle.ByCenterPointRadius(centerPoint=flatten, radius=flatten_2)
boolean = BoolSelector(true)
byPoints = PolyCurve.ByPoints(points=flatten, connectLastToFirst=boolean)
byPatch = Surface.ByPatch(closedCurve=byPoints)
thicken = Surface.Thicken(surface=byPatch)
centroid = Solid.Centroid(solid=thicken)
byStartPointEndPoint = Line.ByStartPointEndPoint(startPoint=centroid, endPoint=flatten)
explode = Geometry.Explode(geometry=byPoints)
count = List.Count(list=explode)
code_block_2 = CodeBlock { 0; 1; }
number_slider_10 = DoubleSlider(52.2, range=0..100 step 0.1)
randomList = Math.RandomList(amount=count, value1=code_block_2.out0, value2=code_block_2.out1, seed=number_slider_10)
pointAtParameter = Curve.PointAtParameter(curve=byStartPointEndPoint, param=randomList)
byCenterPointRadius_2 = Circle.ByCenterPointRadius(centerPoint=pointAtParameter, radius=flatten_2)
byPatch_2 = Surface.ByPatch(closedCurve=byCenterPointRadius_2)
thicken_2 = Surface.Thicken(surface=byPatch_2)
byUnion = Solid.ByUnion(solids=thicken_2)
volume = Solid.Volume(solid=byUnion)
watch = Watch(volume)
volume_2 = Solid.Volume(solid=thicken_2)
sum = Math.Sum(values=volume_2)
watch_2 = Watch(sum)
code_block_3 = CodeBlock(union=watch, each=watch_2) { union - each; }
watch_3 = Watch(code_block_3)
