# Dynamo graph 0730 space planning test 002CN_mk.dyn (Dynamo 2.10.1.3976)
# packages: GenerativeDesign.Revit 1.7.3.0, GenerativeDesign 1.7.3.0, Clockwork for Dynamo 2.x 2.3.0

# group: User Inputs for GDIR
# note: Custom Package: GenerativeDesign v.2021.5.5
select_room_to_load_program_into = DSModelRoomSelection()  # 1 picked in the model; graph input
# note: Retrieve the room's finish boundary.
# Note: The first sublist is the outermost boundary of the room.
finishBoundary = Room.FinishBoundary(room=select_room_to_load_program_into)
remember = Data.Remember(finishBoundary)

# group: Extract room boundary for DynaSpace and cache it in the graph
firstItem = List.FirstItem(list=remember@L3)
startPoint = Curve.StartPoint(curve=firstItem)
flatten = List.Flatten(list=startPoint)
byJoinedCurves = PolyCurve.ByJoinedCurves(curves=firstItem)
code_block = CodeBlock(RoomBoundary=byJoinedCurves)
# ---------- code_block.designscript (3 lines) ----------
{
"RoomBoundary": _RoomBoundary
};
# ----------------------------------------

# group: Display/Validation
the_outermost_room_boundary = Watch3D(code_block)

# group: 매스의 중점 최외곽 라인 형성 및 surface 형성
flatten_2 = List.Flatten()  # frozen; unwired: list
explode = Geometry.Explode(geometry=flatten_2)
startPoint_2 = Curve.StartPoint(curve=explode)
flatten_3 = List.Flatten(list=startPoint_2)

Z = Point.Z(point=flatten_3)
uniqueItems = List.UniqueItems(list=Z)
eq = Z@L2 == uniqueItems@L1  # lacing=CrossProduct
code_block_2 = CodeBlock { 1; }
flatten_4 = List.Flatten(list=eq, amt=code_block_2)
filterByBoolMask = List.FilterByBoolMask(list=flatten_3@L2, mask=flatten_4@L2)
watch = Watch(filterByBoolMask.in)
code_block_3 = CodeBlock { 0; }
getItemAtIndex = List.GetItemAtIndex(list=watch@L3, index=code_block_3)

# group (continued): 매스의 중점 최외곽 라인 형성 및 surface 형성
graham_scan = Python(IN[0]=getItemAtIndex)  # IronPython2
# ---------- graham_scan.python (55 lines) ----------
import clr
clr.AddReference('ProtoGeometry')
from Autodesk.DesignScript.Geometry import *

def ToVals(pt):
	return [pt.X,pt.Y,pt.Z]

def ToPts(ptVals):
	return Point.ByCoordinates(ptVals[0],ptVals[1],ptVals[2])

def CreateOutline(pts):
	crvs = []
	i = 0
	while i < len(pts):
		if i == len(pts)-1:
			crvs.append(Line.ByStartPointEndPoint(pts[i],pts[0]))
		else:
			crvs.append(Line.ByStartPointEndPoint(pts[i],pts[i+1]))
		i = i+1
	return PolyCurve.ByJoinedCurves(crvs)

'''
Taken from Thomas Switzers awesome GitHub repo and modified to suit Dynamo Context
https://gist.github.com/arthur-e/5cf52962341310f438e96c1f3c3398b8
I take zero credit for this work other than porting it across.
'''
def convex_hull_graham(points):
	'''
	Returns points on convex hull in CCW order according to Graham's scan algorithm. 
	By Tom Switzer <thomas.switzer@gmail.com>.
	'''
	TURN_LEFT, TURN_RIGHT, TURN_NONE = (1, -1, 0)

	def cmp(a, b):
		return (a > b) - (a < b)
	
	def turn(p, q, r):
		return cmp((q[0] - p[0])*(r[1] - p[1]) - (r[0] - p[0])*(q[1] - p[1]), 0)
	
	def _keep_left(hull, r):
		while len(hull) > 1 and turn(hull[-2], hull[-1], r) != TURN_LEFT:
			hull.pop()
		if not len(hull) or hull[-1] != r:
			hull.append(r)
		return hull

	points = [ToVals(p) for p in points]	
	points = sorted(points)
	l = reduce(_keep_left, points, [])
	u = reduce(_keep_left, reversed(points), [])
	points = l.extend(u[i] for i in range(1, len(u) - 1)) or l
	points = [ToPts(p) for p in points]
	return CreateOutline(points)

OUT = convex_hull_graham(IN[0])
# ----------------------------------------
byPatch = Surface.ByPatch(closedCurve=graham_scan)

# group: Excel Data import (package 정리 전)
file_path = Filename(".\space planning test 0730 001.xlsx")
file_from_path = FileObject(path=file_path)
string_from_object = FromObject(object=file_from_path)
code_block_4 = CodeBlock { "Sheet1"; "SampleBuildingProgram-Clinic"; false; }
python_script_import_excel_by = Python(IN[0]=string_from_object, IN[1]=code_block_4.out0)  # "Python Script@Import Excel(By OpenpyXl)"; CPython3
# ---------- python_script_import_excel_by.python (50 lines) ----------
# Load the Python Standard and DesignScript Libraries
import sys
import os
#sys.path.append(r'C:\Users\HEC\AppData\Local\Programs\Python\Python39\Lib\site-packages')
#sys.path.append(r'C:\Users\pjmk0\AppData\Local\Programs\Python\Python39\Lib\site-packages')
sys.path.append(os.getenv('LOCALAPPDATA').replace('\\','\\\\') + r'\Programs\Python\Python39\Lib\site-packages')
import clr
clr.AddReference('ProtoGeometry')
from Autodesk.DesignScript.Geometry import *
from collections import Iterable

def iterable(obj):
    return isinstance(obj, Iterable)


# The inputs to this node will be stored as a list in the IN variables.
dataEnteringNode = IN
PathIn = IN[0]
SheetNameIn = IN[1]

# Place your code below this line
import datetime
import openpyxl

path = (PathIn)
#path = (r'C:\Users\pjmk0\Downloads\MK\mQ\BIM_물량집계 자동화 산출기준표_rC(20210607)_mk_de.xlsx')

wb_obj = openpyxl.load_workbook(path, data_only=True)
sheet_obj = wb_obj.get_sheet_by_name(SheetNameIn)

m_row = sheet_obj.max_row
m_col = sheet_obj.max_column

listOut = []



for i in range(1, m_row +1):
    listTemp = []
    for j in range(1, m_col + 1):
        cell_obj = sheet_obj.cell(row=i, column=j)
        listTemp.append(cell_obj.value)
        if len(listTemp) == m_col:
            listOut.append(listTemp)
        


# Assign your output to the OUT variable.
OUT = listOut
#OUT = os.getenv('APPDATA')
# ----------------------------------------
excel_data_정리_전 = Watch(python_script_import_excel_by)

remember_2 = Data.Remember(excel_data_정리_전)

# group: Excel List 분할
excel_data_정리_전_2 = Watch(remember_2)
transpose = List.Transpose(lists=excel_data_정리_전_2)
code_block_5 = CodeBlock { 1; }
# note: List Name 정리
dropItems = List.DropItems(list=transpose@L2, amount=code_block_5)
watch_2 = Watch(dropItems)
code_block_6 = CodeBlock { 0; }
getItemAtIndex_2 = List.GetItemAtIndex(list=watch_2, index=code_block_6)
space_id = Watch(getItemAtIndex_2)
code_block_7 = CodeBlock { 1; }
getItemAtIndex_3 = List.GetItemAtIndex(list=watch_2, index=code_block_7)
space_name = Watch(getItemAtIndex_3)
code_block_8 = CodeBlock { 10; }
getItemAtIndex_4 = List.GetItemAtIndex(list=watch_2, index=code_block_8)
adjacent_spaces = Watch(getItemAtIndex_4)
code_block_9 = CodeBlock { 3; }
getItemAtIndex_5 = List.GetItemAtIndex(list=watch_2, index=code_block_9)
department_id = Watch(getItemAtIndex_5)
code_block_10 = CodeBlock { 2; }
getItemAtIndex_6 = List.GetItemAtIndex(list=watch_2, index=code_block_10)
DEPARTMENT = Watch(getItemAtIndex_6)
lastItem = List.LastItem(list=watch_2)
lev = Watch(lastItem)
code_block_11 = CodeBlock { 5; }
getItemAtIndex_7 = List.GetItemAtIndex(list=watch_2, index=code_block_11)
WIDTH = Watch(getItemAtIndex_7)
code_block_12 = CodeBlock { 6; }
getItemAtIndex_8 = List.GetItemAtIndex(list=watch_2, index=code_block_12)
length = Watch(getItemAtIndex_8)
code_block_13 = CodeBlock { 7; }
getItemAtIndex_9 = List.GetItemAtIndex(list=watch_2, index=code_block_13)
AREA = Watch(getItemAtIndex_9)
code_block_14 = CodeBlock { 11; }
getItemAtIndex_10 = List.GetItemAtIndex(list=watch_2, index=code_block_14)
AREA_2 = Watch(getItemAtIndex_10)
code_block_15 = CodeBlock(ExcelDataWithNoHead=watch_2, SpaceID=space_id, SpaceName=space_name, AdjacentSpaces=adjacent_spaces, DepartmentID=department_id, Department=DEPARTMENT, Level=lev, Width=WIDTH, Length=length, Area=AREA, AdjacentDepartments=AREA_2)
# ---------- code_block_15.designscript (13 lines) ----------
{
"ExcelDataWithNoHead": _ExcelDataWithNoHead,
"SpaceID": _SpaceID,
"SpaceName": _SpaceName,
"AdjacentSpaces": _AdjacentSpaces,
"DepartmentID": _DepartmentID,
"Department": _Department,
"Level": _Level,
"Width": _Width,
"Length": _Length,
"Area": _Area,
"AdjacentDepartments": _AdjacentDepartments
};
# ----------------------------------------

code_block_16 = CodeBlock { "SpaceID"; }
valueAtKey = DesignScript.Builtin.Dictionary.ValueAtKey(dictionary=code_block_15, key=code_block_16)
code_block_17 = CodeBlock { "ExcelDataWithNoHead"; }
valueAtKey_2 = DesignScript.Builtin.Dictionary.ValueAtKey(dictionary=code_block_15, key=code_block_17)

# group: Department 그룹
code_block_18 = CodeBlock { 2; }
getItemAtIndex_11 = List.GetItemAtIndex(list=valueAtKey_2, index=code_block_18)
watch_3 = Watch(getItemAtIndex_11)
uniqueItems_2 = List.UniqueItems(list=watch_3)
eq_2 = uniqueItems_2 == watch_3  # lacing=CrossProduct

# group: 룸 BoundingBox 포인트 추출
code_block_19 = CodeBlock(InputDic=code_block) { _InputDic; }
code_block_20 = CodeBlock { "RoomBoundary"; }
valueAtKey_3 = DesignScript.Builtin.Dictionary.ValueAtKey(dictionary=code_block_19, key=code_block_20)
byGeometry = BoundingBox.ByGeometry(geom=valueAtKey_3)
minPoint = BoundingBox.MinPoint(boundingBox=byGeometry)
X = Point.X(point=minPoint)
maxPoint = BoundingBox.MaxPoint(boundingBox=byGeometry)
X_2 = Point.X(point=maxPoint)
code_block_21 = CodeBlock { 500; }
code_block_22 = CodeBlock(a=X, b=X_2, x=code_block_21) { a..b..x; }
Y = Point.Y(point=minPoint)
Y_2 = Point.Y(point=maxPoint)
code_block_23 = CodeBlock { 500; }
code_block_24 = CodeBlock(a=Y, b=Y_2, x=code_block_23) { a..b..x; }
byCoordinates = Point.ByCoordinates(x=code_block_22, y=code_block_24, lacing=CrossProduct)
flatten_5 = List.Flatten(list=byCoordinates)
count = List.Count(list=flatten_5)

code_block_25 = CodeBlock { "DepartmentID"; }
valueAtKey_4 = DesignScript.Builtin.Dictionary.ValueAtKey(dictionary=code_block_15, key=code_block_25)

# group: 고정부/변동부 구별
code_block_26 = CodeBlock(InputDic=code_block_15) { _InputDic; }
code_block_27 = CodeBlock { "DepartmentID"; }
valueAtKey_5 = DesignScript.Builtin.Dictionary.ValueAtKey(dictionary=code_block_26, key=code_block_27)
department_id_2 = Watch(valueAtKey_5)
# note: 3 = Path V = 계단
code_block_28 = CodeBlock { 3; }
eq_3 = department_id_2 == code_block_28
boolean = BoolSelector(true)
allIndicesOf = List.AllIndicesOf(list=eq_3, item=boolean)
boolean_2 = BoolSelector(false)
allIndicesOf_2 = List.AllIndicesOf(list=eq_3, item=boolean_2)
code_block_29 = CodeBlock(FixedPartIndex=allIndicesOf, NonFixedPartIndex=allIndicesOf_2)
# ---------- code_block_29.designscript (4 lines) ----------
{
"FixedPartIndex": _FixedPartIndex,
"NonFixedPartIndex": _NonFixedPartIndex
};
# ----------------------------------------
extendsChildDictionaryFromParent = Custom[ExtendsChildDictionaryFromParent](ParentDic=code_block_26, ChildDic=code_block_29)  # Extends Child Dictionary From Parent

code_block_30 = CodeBlock { "Level"; }
valueAtKey_6 = DesignScript.Builtin.Dictionary.ValueAtKey(dictionary=code_block_15, key=code_block_30)

# group: Level에 따라 Z 값 Dictionary 추출
lev_2 = Watch(valueAtKey_6)
uniqueItems_3 = List.UniqueItems(list=lev_2)
code_block_31 = CodeBlock { 0..4000..2000; }
byKeysValues = DesignScript.Builtin.Dictionary.ByKeysValues(keys=uniqueItems_3, values=code_block_31)
watch_4 = Watch(byKeysValues)
valueAtKey_7 = DesignScript.Builtin.Dictionary.ValueAtKey(dictionary=watch_4, key=lev_2)
z_값_lev_에서_추출 = Watch(valueAtKey_7)

lev_3 = Watch(lev_2)

# group: 고정부 Seed
seed_고정부_코어 = DoubleSlider(349, range=0..999 step 1)  # graph input

# group: 층별 고정부 Index 추출
getItemAtIndex_12 = List.GetItemAtIndex(list=lev_3, index=allIndicesOf)
uniqueItems_4 = List.UniqueItems(list=getItemAtIndex_12)
eq_4 = uniqueItems_4 == getItemAtIndex_12  # lacing=CrossProduct
countTrue = List.CountTrue(list=eq_4@L2)
code_block_32 = CodeBlock { 0; }
watch_5 = Watch(count)
randomList = Math.RandomList(amount=countTrue, value1=code_block_32, value2=watch_5, seed=seed_고정부_코어)
watch_6 = Watch(randomList)
round = Math.Round(number=watch_6)

# group: 변동부 Seed
seed_변형부_공간 = DoubleSlider(893, range=0..999 step 1)  # graph input

# group: 층별 변동동부 Index 추출
getItemAtIndex_13 = List.GetItemAtIndex(list=lev_3, index=allIndicesOf_2)
uniqueItems_5 = List.UniqueItems(list=getItemAtIndex_13)
eq_5 = uniqueItems_5 == getItemAtIndex_13  # lacing=CrossProduct
countTrue_2 = List.CountTrue(list=eq_5@L2)
sum = Math.Sum(values=countTrue_2)
code_block_33 = CodeBlock { 0; }
watch_7 = Watch(count)
randomList_2 = Math.RandomList(amount=sum, value1=code_block_33, value2=watch_7, seed=seed_변형부_공간)
watch_8 = Watch(randomList_2)
round_2 = Math.Round(number=watch_8)

# group: Point Index List 추출
count_2 = List.Count(list=valueAtKey_4)
code_block_34 = CodeBlock(a=count_2) { a-1; }
code_block_35 = CodeBlock(a=code_block_34) { 0..a..1; }
firstItem_2 = List.FirstItem(list=round)

firstItem_3 = List.FirstItem(list=firstItem_2)

# group (continued): Point Index List 추출
replaceItemAtIndex = Custom[List.ReplaceItemAtIndex+](seq=code_block_35, indices=allIndicesOf, replacement=firstItem_3)  # package Clockwork for Dynamo 2.x; Replaces the item at a given index of a list by another item. Unlike the OOTB node, it can replace items at multiple indeces.
replaceItemAtIndex_2 = Custom[List.ReplaceItemAtIndex+](seq=replaceItemAtIndex, indices=allIndicesOf_2, replacement=round_2)
point_index_list_추출 = Watch(replaceItemAtIndex_2)

# group: Center Points
flatten_6 = List.Flatten(list=point_index_list_추출)
getItemAtIndex_14 = List.GetItemAtIndex(list=flatten_5, index=flatten_6)
X_3 = Point.X(point=getItemAtIndex_14)
Y_3 = Point.Y(point=getItemAtIndex_14)
byCoordinates_2 = Point.ByCoordinates(x=X_3, y=Y_3, z=z_값_lev_에서_추출, lacing=Shortest)

code_block_36 = CodeBlock { "AdjacentSpaces"; }
valueAtKey_8 = DesignScript.Builtin.Dictionary.ValueAtKey(dictionary=code_block_15, key=code_block_36)
code_block_37 = CodeBlock { "Area"; }
valueAtKey_9 = DesignScript.Builtin.Dictionary.ValueAtKey(dictionary=code_block_15, key=code_block_37)

# group: Lev 높이
code_block_38 = CodeBlock { 2000; }

code_block_39 = CodeBlock { 1; }
getItemAtIndex_15 = List.GetItemAtIndex(list=watch@L2, index=code_block_39)
code_block_40 = CodeBlock { 1; }
getItemAtIndex_16 = List.GetItemAtIndex(list=watch, index=code_block_40)
code_block_41 = CodeBlock { "Width"; }
valueAtKey_10 = DesignScript.Builtin.Dictionary.ValueAtKey(dictionary=code_block_15, key=code_block_41)

# group: Department로 List 분류
space_id_2 = Watch(valueAtKey)
filterByBoolMask_2 = List.FilterByBoolMask(list=space_id_2, mask=eq_2@L2)
watch_9 = Watch(filterByBoolMask_2.in)
filterByBoolMask_3 = List.FilterByBoolMask(list=byCoordinates_2, mask=eq_2@L2)
watch_10 = Watch(filterByBoolMask_3.in)
AREA_3 = Watch(valueAtKey_9)
code_block_42 = CodeBlock(a=AREA_3) { a/2; }
filterByBoolMask_4 = List.FilterByBoolMask(list=code_block_42, mask=eq_2@L2)
watch_11 = Watch(filterByBoolMask_4.in)
WIDTH_2 = Watch(valueAtKey_10)

# group: Index - Point Dirctionary (삭제?)
flatten_7 = List.Flatten(list=watch_9)
watch_12 = Watch(flatten_7)
string_from_object_2 = FromObject(object=watch_12)
flatten_8 = List.Flatten(list=watch_10)
watch_13 = Watch(flatten_8)
byKeysValues_2 = DesignScript.Builtin.Dictionary.ByKeysValues(keys=string_from_object_2, values=watch_13)
watch_14 = Watch(byKeysValues_2)
sort = List.Sort(list=flatten_7)
watch_15 = Watch(sort)
string_from_object_3 = FromObject(object=watch_15)
valueAtKey_11 = DesignScript.Builtin.Dictionary.ValueAtKey(dictionary=watch_14, key=string_from_object_3)

# group: 0~10 정배열 List Point 변경
X_4 = Point.X(point=valueAtKey_11)
Y_4 = Point.Y(point=valueAtKey_11)
z_값_lev_에서_추출_2 = Watch(z_값_lev_에서_추출)
byCoordinates_3 = Point.ByCoordinates(x=X_4, y=Y_4, z=z_값_lev_에서_추출_2)
정배열_points = Watch(byCoordinates_3)

# group: ADJACENT SPACES 연결을 위한 List 정리 / Line 추출
정배열_points_2 = Watch(정배열_points)
space_id_3 = Watch(valueAtKey)
getItemAtIndex_17 = List.GetItemAtIndex(list=정배열_points_2, index=space_id_3)
watch_16 = Watch(valueAtKey_8)
code_block_43 = CodeBlock { ","; }
split = String.Split(str=watch_16@L1, separator0=code_block_43)
flatten_9 = List.Flatten(list=split)
string_from_object_4 = FromObject(object=flatten_9)
adjacent_spaces_flatten = Watch(string_from_object_4)
toNumber = String.ToNumber(str=adjacent_spaces_flatten)
getItemAtIndex_18 = List.GetItemAtIndex(list=정배열_points_2, index=toNumber)
count_3 = List.Count(list=split@L2)
chop = List.Chop(list=getItemAtIndex_18, lengths=count_3)
byStartPointEndPoint = Line.ByStartPointEndPoint(startPoint=getItemAtIndex_17, endPoint=chop, lacing=Shortest)

# group: 버블 다이어그램용 원 (반지름 변경 전)
sqrt = Math.Sqrt(number=watch_11)
byCenterPointRadius = Circle.ByCenterPointRadius(centerPoint=watch_10, radius=sqrt)

# group: 부서별 Point 분류
getItemAtIndex_19 = List.GetItemAtIndex(list=정배열_points, index=watch_12)
count_4 = List.Count(list=watch_10@L2)
chop_2 = List.Chop(list=getItemAtIndex_19, lengths=count_4)

# group: REC (사각형) 변경 전
radius = Circle.Radius(circle=byCenterPointRadius)
code_block_44 = CodeBlock(a=radius) { a*2; }
byWidthLength = Rectangle.ByWidthLength(width=code_block_44, length=code_block_44)
X_5 = Point.X(point=chop_2)
Y_5 = Point.Y(point=chop_2)
Z_2 = Point.Z(point=chop_2)
translate = Geometry.Translate(geometry=byWidthLength, xTranslation=X_5, yTranslation=Y_5, zTranslation=Z_2)
byPatch_2 = Surface.ByPatch(closedCurve=translate)

# group: 부서별 색상 지정
watch_17 = Watch(watch_3)
uniqueItems_6 = List.UniqueItems(list=watch_17)
remember_3 = Data.Remember()  # unwired: arg0
remember_4 = Data.Remember()  # unwired: arg0
remember_5 = Data.Remember()  # unwired: arg0
remember_6 = Data.Remember()  # unwired: arg0
remember_7 = Data.Remember()  # unwired: arg0
remember_8 = Data.Remember()  # unwired: arg0
join = List.Join(list0=remember_3, list1=remember_4, list2=remember_5, list3=remember_6, list4=remember_7, list5=remember_8)
byKeysValues_3 = DesignScript.Builtin.Dictionary.ByKeysValues(keys=uniqueItems_6, values=join)
getItemAtIndex_20 = List.GetItemAtIndex(list=watch_17, index=flatten_7)

# group: 사각 공간 색상 지정
boolean_3 = BoolSelector(true)
thicken = Surface.Thicken(surface=byPatch_2, thickness=code_block_38, both_sides=boolean_3)
valueAtKey_12 = DesignScript.Builtin.Dictionary.ValueAtKey(dictionary=byKeysValues_3, key=getItemAtIndex_20)
count_5 = List.Count(list=thicken@L2)
chop_3 = List.Chop(list=valueAtKey_12, lengths=count_5)
byGeometryColor = Modifiers.GeometryColor.ByGeometryColor(geometry=thicken, color=chop_3)

# group: 삭제 예정
code_block_45 = CodeBlock {  }
code_block_46 = CodeBlock {  }

flatten_10 = List.Flatten(list=round)
keys = DesignScript.Builtin.Dictionary.Keys(dictionary=extendsChildDictionaryFromParent.dictionary)
watch_18 = Watch(extendsChildDictionaryFromParent.key)
