# Dynamo custom node ExtendsChildDictionaryFromParent.dyf (Dynamo 2.10.1.3976)
# category: mQTest
# Extends Child Dictionary From Parent

ParentDic = Input(_ParentDic: var[]..[])
ChildDic = Input(_ChildDic: var[]..[])

# group: Extends Child Dictionary From Parent
code_block = CodeBlock(ParentDic=ParentDic) { _ParentDic; }
components = DesignScript.Builtin.Dictionary.Components(dictionary=code_block)
code_block_2 = CodeBlock(ChildDic=ChildDic) { _ChildDic; }
components_2 = DesignScript.Builtin.Dictionary.Components(dictionary=code_block_2)
code_block_3 = CodeBlock(ChildDicKeys=components_2.keys) { _ChildDicKeys; }
join = List.Join(list0=components.keys, list1=code_block_3)
code_block_4 = CodeBlock(ChildDicValues=components_2.values) { _ChildDicValues; }
join_2 = List.Join(list0=components.values, list1=code_block_4)
byKeysValues = DesignScript.Builtin.Dictionary.ByKeysValues(keys=join, values=join_2)
keys = DesignScript.Builtin.Dictionary.Keys(dictionary=byKeysValues)

dictionary = Output(byKeysValues)
key = Output(keys)
