# Dynamo graph 0731 space planning test 002CN_mk.dyn (Dynamo 2.10.1.3976)
# packages: GenerativeDesign.Revit 1.7.3.0, GenerativeDesign 1.7.3.0, Clockwork for Dynamo 2.x 2.3.0

# group: User Inputs for GDIR
# note: Custom Package: GenerativeDesign v.2021.5.5
select_room_to_load_program_into = DSModelRoomSelection()  # 1 picked in the model; graph input
# note: Retrieve the room's finish boundary.
# Note: The first sublist is the outermost boundary of the room.
finishBoundary = Room.FinishBoundary(room=select_room_to_load_program_into)
remember = Data.Remember(finishBoundary)

# group: Extract room boundary for DynaSpace and cache it in the graph
firstItem = List.FirstItem(list=remember@L3)
startPoint = Curve.StartPoint(curve=firstItem)
flatten = List.Flatten(list=startPoint)
byJoinedCurves = PolyCurve.ByJoinedCurves(curves=firstItem)
code_block = CodeBlock(RoomBoundary=byJoinedCurves)
# ---------- code_block.designscript (3 lines) ----------
{
"RoomBoundary": _RoomBoundary
};
# ----------------------------------------

# group: 매스의 중점 최외곽 라인 형성 및 surface 형성
flatten_2 = List.Flatten()  # frozen; unwired: list
explode = Geometry.Explode(geometry=flatten_2)
startPoint_2 = Curve.StartPoint(curve=explode)
flatten_3 = List.Flatten(list=startPoint_2)

Z = Point.Z(point=flatten_3)
uniqueItems = List.UniqueItems(list=Z)
eq = Z@L2 == uniqueItems@L1  # lacing=CrossProduct
code_block_2 = CodeBlock { 1; }
flatten_4 = List.Flatten(list=eq, amt=code_block_2)
filterByBoolMask = List.FilterByBoolMask(list=flatten_3@L2, mask=flatten_4@L2)
watch = Watch(filterByBoolMask.in)
code_block_3 = CodeBlock { 0; }
getItemAtIndex = List.GetItemAtIndex(list=watch@L3, index=code_block_3)

# group (continued): 매스의 중점 최외곽 라인 형성 및 surface 형성
graham_scan = Python(IN[0]=getItemAtIndex)  # IronPython2
# ---------- graham_scan.python (55 lines) ----------
import clr
clr.AddReference('ProtoGeometry')
from Autodesk.DesignScript.Geometry import *

def ToVals(pt):
	return [pt.X,pt.Y,pt.Z]

def ToPts(ptVals):
	return Point.ByCoordinates(ptVals[0],ptVals[1],ptVals[2])

def CreateOutline(pts):
	crvs = []
	i = 0
	while i < len(pts):
		if i == len(pts)-1:
			crvs.append(Line.ByStartPointEndPoint(pts[i],pts[0]))
		else:
			crvs.append(Line.ByStartPointEndPoint(pts[i],pts[i+1]))
		i = i+1
	return PolyCurve.ByJoinedCurves(crvs)

'''
Taken from Thomas Switzers awesome GitHub repo and modified to suit Dynamo Context
https://gist.github.com/arthur-e/5cf52962341310f438e96c1f3c3398b8
I take zero credit for this work other than porting it across.
'''
def convex_hull_graham(points):
	'''
	Returns points on convex hull in CCW order according to Graham's scan algorithm. 
	By Tom Switzer <thomas.switzer@gmail.com>.
	'''
	TURN_LEFT, TURN_RIGHT, TURN_NONE = (1, -1, 0)

	def cmp(a, b):
		return (a > b) - (a < b)
	
	def turn(p, q, r):
		return cmp((q[0] - p[0])*(r[1] - p[1]) - (r[0] - p[0])*(q[1] - p[1]), 0)
	
	def _keep_left(hull, r):
		while len(hull) > 1 and turn(hull[-2], hull[-1], r) != TURN_LEFT:
			hull.pop()
		if not len(hull) or hull[-1] != r:
			hull.append(r)
		return hull

	points = [ToVals(p) for p in points]	
	points = sorted(points)
	l = reduce(_keep_left, points, [])
	u = reduce(_keep_left, reversed(points), [])
	points = l.extend(u[i] for i in range(1, len(u) - 1)) or l
	points = [ToPts(p) for p in points]
	return CreateOutline(points)

OUT = convex_hull_graham(IN[0])
# ----------------------------------------
byPatch = Surface.ByPatch(closedCurve=graham_scan)

# group: Excel Data import (package 정리 전)
file_path = Filename(".\space planning test 0730 001.xlsx")
file_from_path = FileObject(path=file_path)
string_from_object = FromObject(object=file_from_path)
code_block_4 = CodeBlock { "Sheet1"; "SampleBuildingProgram-Clinic"; false; }
python_script_import_excel_by = Python(IN[0]=string_from_object, IN[1]=code_block_4.out0)  # "Python Script@Import Excel(By OpenpyXl)"; CPython3
# ---------- python_script_import_excel_by.python (50 lines) ----------
# Load the Python Standard and DesignScript Libraries
import sys
import os
#sys.path.append(r'C:\Users\HEC\AppData\Local\Programs\Python\Python39\Lib\site-packages')
#sys.path.append(r'C:\Users\pjmk0\AppData\Local\Programs\Python\Python39\Lib\site-packages')
sys.path.append(os.getenv('LOCALAPPDATA').replace('\\','\\\\') + r'\Programs\Python\Python39\Lib\site-packages')
import clr
clr.AddReference('ProtoGeometry')
from Autodesk.DesignScript.Geometry import *
from collections import Iterable

def iterable(obj):
    return isinstance(obj, Iterable)


# The inputs to this node will be stored as a list in the IN variables.
dataEnteringNode = IN
PathIn = IN[0]
SheetNameIn = IN[1]

# Place your code below this line
import datetime
import openpyxl

path = (PathIn)
#path = (r'C:\Users\pjmk0\Downloads\MK\mQ\BIM_물량집계 자동화 산출기준표_rC(20210607)_mk_de.xlsx')

wb_obj = openpyxl.load_workbook(path, data_only=True)
sheet_obj = wb_obj.get_sheet_by_name(SheetNameIn)

m_row = sheet_obj.max_row
m_col = sheet_obj.max_column

listOut = []



for i in range(1, m_row +1):
    listTemp = []
    for j in range(1, m_col + 1):
        cell_obj = sheet_obj.cell(row=i, column=j)
        listTemp.append(cell_obj.value)
        if len(listTemp) == m_col:
            listOut.append(listTemp)
        


# Assign your output to the OUT variable.
OUT = listOut
#OUT = os.getenv('APPDATA')
# ----------------------------------------
excel_data_정리_전 = Watch(python_script_import_excel_by)

remember_2 = Data.Remember(excel_data_정리_전)

# group: 고정부 Seed
seed_고정부_코어 = DoubleSlider(405, range=0..999 step 1)  # graph input

# group: 변동부 Seed
seed_변형부_공간 = DoubleSlider(704, range=0..999 step 1)  # graph input

# group: Lev 높이
number = DoubleInput(2000)

code_block_5 = CodeBlock(FixedPartSeed=seed_고정부_코어, NonFixedPartSeed=seed_변형부_공간, BoxHeight=number)
# ---------- code_block_5.designscript (5 lines) ----------
{
"FixedPartSeed": _FixedPartSeed,
"NonFixedPartSeed": _NonFixedPartSeed,
"BoxHeight": _BoxHeight
};
# ----------------------------------------
extendsChildDictionaryFromParent = Custom[ExtendsChildDictionaryFromParent](ParentDic=code_block, ChildDic=code_block_5)  # Extends Child Dictionary From Parent

# group: Excel List 분할
excel_data_정리_전_2 = Watch(remember_2)
transpose = List.Transpose(lists=excel_data_정리_전_2)
code_block_6 = CodeBlock { 1; }
# note: List Name 정리
dropItems = List.DropItems(list=transpose@L2, amount=code_block_6)
watch_2 = Watch(dropItems)
code_block_7 = CodeBlock { 0; }
getItemAtIndex_2 = List.GetItemAtIndex(list=watch_2, index=code_block_7)
space_id = Watch(getItemAtIndex_2)
code_block_8 = CodeBlock { 1; }
getItemAtIndex_3 = List.GetItemAtIndex(list=watch_2, index=code_block_8)
space_name = Watch(getItemAtIndex_3)
code_block_9 = CodeBlock { 10; }
getItemAtIndex_4 = List.GetItemAtIndex(list=watch_2, index=code_block_9)
adjacent_spaces = Watch(getItemAtIndex_4)
code_block_10 = CodeBlock { 3; }
getItemAtIndex_5 = List.GetItemAtIndex(list=watch_2, index=code_block_10)
department_id = Watch(getItemAtIndex_5)
code_block_11 = CodeBlock { 2; }
getItemAtIndex_6 = List.GetItemAtIndex(list=watch_2, index=code_block_11)
DEPARTMENT = Watch(getItemAtIndex_6)
lastItem = List.LastItem(list=watch_2)
lev = Watch(lastItem)
code_block_12 = CodeBlock { 5; }
getItemAtIndex_7 = List.GetItemAtIndex(list=watch_2, index=code_block_12)
WIDTH = Watch(getItemAtIndex_7)
code_block_13 = CodeBlock { 6; }
getItemAtIndex_8 = List.GetItemAtIndex(list=watch_2, index=code_block_13)
length = Watch(getItemAtIndex_8)
code_block_14 = CodeBlock { 7; }
getItemAtIndex_9 = List.GetItemAtIndex(list=watch_2, index=code_block_14)
AREA = Watch(getItemAtIndex_9)
code_block_15 = CodeBlock { 11; }
getItemAtIndex_10 = List.GetItemAtIndex(list=watch_2, index=code_block_15)
AREA_2 = Watch(getItemAtIndex_10)
code_block_16 = CodeBlock(ExcelDataWithNoHead=watch_2, SpaceID=space_id, SpaceName=space_name, AdjacentSpaces=adjacent_spaces, DepartmentID=department_id, Department=DEPARTMENT, Level=lev, Width=WIDTH, Length=length, Area=AREA, AdjacentDepartments=AREA_2)
# ---------- code_block_16.designscript (13 lines) ----------
{
"ExcelDataWithNoHead": _ExcelDataWithNoHead,
"SpaceID": _SpaceID,
"SpaceName": _SpaceName,
"AdjacentSpaces": _AdjacentSpaces,
"DepartmentID": _DepartmentID,
"Department": _Department,
"Level": _Level,
"Width": _Width,
"Length": _Length,
"Area": _Area,
"AdjacentDepartments": _AdjacentDepartments
};
# ----------------------------------------
extendsChildDictionaryFromParent_2 = Custom[ExtendsChildDictionaryFromParent](ParentDic=code_block_16, ChildDic=extendsChildDictionaryFromParent.dictionary)

# group: Level에 따라 Z 값 Dictionary 추출
code_block_17 = CodeBlock(InputDic=extendsChildDictionaryFromParent_2.dictionary) { _InputDic; }
code_block_18 = CodeBlock { "Level"; }
valueAtKey = DesignScript.Builtin.Dictionary.ValueAtKey(dictionary=code_block_17, key=code_block_18)
lev_2 = Watch(valueAtKey)
uniqueItems_2 = List.UniqueItems(list=lev_2)
code_block_19 = CodeBlock { 0..4000..2000; }
byKeysValues = DesignScript.Builtin.Dictionary.ByKeysValues(keys=uniqueItems_2, values=code_block_19)
watch_3 = Watch(byKeysValues)
valueAtKey_2 = DesignScript.Builtin.Dictionary.ValueAtKey(dictionary=watch_3, key=lev_2)
z_값_lev_에서_추출 = Watch(valueAtKey_2)
code_block_20 = CodeBlock(ZvalueFromLevel=z_값_lev_에서_추출)
# ---------- code_block_20.designscript (3 lines) ----------
{
"ZvalueFromLevel": _ZvalueFromLevel
};
# ----------------------------------------
extendsChildDictionaryFromParent_3 = Custom[ExtendsChildDictionaryFromParent](ParentDic=code_block_17, ChildDic=code_block_20)

# group: 룸 BoundingBox 포인트 추출
code_block_21 = CodeBlock(InputDic=extendsChildDictionaryFromParent_3.dictionary) { _InputDic; }
code_block_22 = CodeBlock { "RoomBoundary"; }
valueAtKey_3 = DesignScript.Builtin.Dictionary.ValueAtKey(dictionary=code_block_21, key=code_block_22)
byGeometry = BoundingBox.ByGeometry(geom=valueAtKey_3)
minPoint = BoundingBox.MinPoint(boundingBox=byGeometry)
X = Point.X(point=minPoint)
maxPoint = BoundingBox.MaxPoint(boundingBox=byGeometry)
X_2 = Point.X(point=maxPoint)
code_block_23 = CodeBlock { 500; }
code_block_24 = CodeBlock(a=X, b=X_2, x=code_block_23) { a..b..x; }
Y = Point.Y(point=minPoint)
Y_2 = Point.Y(point=maxPoint)
code_block_25 = CodeBlock { 500; }
code_block_26 = CodeBlock(a=Y, b=Y_2, x=code_block_25) { a..b..x; }
byCoordinates = Point.ByCoordinates(x=code_block_24, y=code_block_26, lacing=CrossProduct)
flatten_5 = List.Flatten(list=byCoordinates)
code_block_27 = CodeBlock(GridPointOfBoundingBox=flatten_5)
# ---------- code_block_27.designscript (3 lines) ----------
{
"GridPointOfBoundingBox": _GridPointOfBoundingBox
};
# ----------------------------------------
extendsChildDictionaryFromParent_4 = Custom[ExtendsChildDictionaryFromParent](ParentDic=code_block_21, ChildDic=code_block_27)

# group: 고정부/변동부 구별
code_block_28 = CodeBlock(InputDic=extendsChildDictionaryFromParent_4.dictionary) { _InputDic; }
code_block_29 = CodeBlock { "DepartmentID"; }
valueAtKey_4 = DesignScript.Builtin.Dictionary.ValueAtKey(dictionary=code_block_28, key=code_block_29)
department_id_2 = Watch(valueAtKey_4)
# note: 3 = Path V = 계단
code_block_30 = CodeBlock { 3; }
eq_2 = department_id_2 == code_block_30
boolean = BoolSelector(true)
allIndicesOf = List.AllIndicesOf(list=eq_2, item=boolean)
boolean_2 = BoolSelector(false)
allIndicesOf_2 = List.AllIndicesOf(list=eq_2, item=boolean_2)
code_block_31 = CodeBlock(FixedPartIndex=allIndicesOf, NonFixedPartIndex=allIndicesOf_2)
# ---------- code_block_31.designscript (4 lines) ----------
{
"FixedPartIndex": _FixedPartIndex,
"NonFixedPartIndex": _NonFixedPartIndex
};
# ----------------------------------------
extendsChildDictionaryFromParent_5 = Custom[ExtendsChildDictionaryFromParent](ParentDic=code_block_28, ChildDic=code_block_31)

# group: 층별 고정부 Point Index 추출
code_block_32 = CodeBlock(InputDic=extendsChildDictionaryFromParent_5.dictionary) { _InputDic; }
code_block_33 = CodeBlock { "Level"; }
valueAtKey_5 = DesignScript.Builtin.Dictionary.ValueAtKey(dictionary=code_block_32, key=code_block_33)
code_block_34 = CodeBlock { "FixedPartIndex"; }
valueAtKey_6 = DesignScript.Builtin.Dictionary.ValueAtKey(dictionary=code_block_32, key=code_block_34)
getItemAtIndex_11 = List.GetItemAtIndex(list=valueAtKey_5, index=valueAtKey_6)
uniqueItems_3 = List.UniqueItems(list=getItemAtIndex_11)
eq_3 = uniqueItems_3 == getItemAtIndex_11  # lacing=CrossProduct
countTrue = List.CountTrue(list=eq_3@L2)
code_block_35 = CodeBlock { 0; }
code_block_36 = CodeBlock { "GridPointOfBoundingBox"; }
valueAtKey_7 = DesignScript.Builtin.Dictionary.ValueAtKey(dictionary=code_block_32, key=code_block_36)
count = List.Count(list=valueAtKey_7)
watch_4 = Watch(count)
code_block_37 = CodeBlock { "FixedPartSeed"; }
valueAtKey_8 = DesignScript.Builtin.Dictionary.ValueAtKey(dictionary=code_block_32, key=code_block_37)
randomList = Math.RandomList(amount=countTrue, value1=code_block_35, value2=watch_4, seed=valueAtKey_8)
watch_5 = Watch(randomList)
round = Math.Round(number=watch_5)
flatten_6 = List.Flatten(list=round)
code_block_38 = CodeBlock(FixedPartPointIndex=flatten_6)
# ---------- code_block_38.designscript (3 lines) ----------
{
"FixedPartPointIndex": _FixedPartPointIndex
};
# ----------------------------------------
extendsChildDictionaryFromParent_6 = Custom[ExtendsChildDictionaryFromParent](ParentDic=code_block_32, ChildDic=code_block_38)

# group: 층별 변동부 Point Index 추출
code_block_39 = CodeBlock(InputDic=extendsChildDictionaryFromParent_6.dictionary) { _InputDic; }
code_block_40 = CodeBlock { "Level"; }
valueAtKey_9 = DesignScript.Builtin.Dictionary.ValueAtKey(dictionary=code_block_39, key=code_block_40)
code_block_41 = CodeBlock { "NonFixedPartIndex"; }
valueAtKey_10 = DesignScript.Builtin.Dictionary.ValueAtKey(dictionary=code_block_39, key=code_block_41)
getItemAtIndex_12 = List.GetItemAtIndex(list=valueAtKey_9, index=valueAtKey_10)
uniqueItems_4 = List.UniqueItems(list=getItemAtIndex_12)
eq_4 = uniqueItems_4 == getItemAtIndex_12  # lacing=CrossProduct
countTrue_2 = List.CountTrue(list=eq_4@L2)
sum = Math.Sum(values=countTrue_2)
code_block_42 = CodeBlock { 0; }
code_block_43 = CodeBlock { "GridPointOfBoundingBox"; }
valueAtKey_11 = DesignScript.Builtin.Dictionary.ValueAtKey(dictionary=code_block_39, key=code_block_43)
count_2 = List.Count(list=valueAtKey_11)
watch_6 = Watch(count_2)
code_block_44 = CodeBlock { "NonFixedPartSeed"; }
valueAtKey_12 = DesignScript.Builtin.Dictionary.ValueAtKey(dictionary=code_block_39, key=code_block_44)
randomList_2 = Math.RandomList(amount=sum, value1=code_block_42, value2=watch_6, seed=valueAtKey_12)
watch_7 = Watch(randomList_2)
round_2 = Math.Round(number=watch_7)
code_block_45 = CodeBlock(NonFixedPartPointIndex=round_2)
# ---------- code_block_45.designscript (3 lines) ----------
{
"NonFixedPartPointIndex": _NonFixedPartPointIndex
};
# ----------------------------------------
extendsChildDictionaryFromParent_7 = Custom[ExtendsChildDictionaryFromParent](ParentDic=code_block_39, ChildDic=code_block_45)

# group: Total Room Point Index List 추출
code_block_46 = CodeBlock(InputDic=extendsChildDictionaryFromParent_7.dictionary) { _InputDic; }
code_block_47 = CodeBlock { "DepartmentID"; }
valueAtKey_13 = DesignScript.Builtin.Dictionary.ValueAtKey(dictionary=code_block_46, key=code_block_47)
count_3 = List.Count(list=valueAtKey_13)
code_block_48 = CodeBlock(a=count_3) { a-1; }
code_block_49 = CodeBlock(a=code_block_48) { 0..a..1; }
code_block_50 = CodeBlock { "FixedPartIndex"; }
valueAtKey_14 = DesignScript.Builtin.Dictionary.ValueAtKey(dictionary=code_block_46, key=code_block_50)
code_block_51 = CodeBlock { "FixedPartPointIndex"; }
valueAtKey_15 = DesignScript.Builtin.Dictionary.ValueAtKey(dictionary=code_block_46, key=code_block_51)
firstItem_2 = List.FirstItem(list=valueAtKey_15)
replaceItemAtIndex = Custom[List.ReplaceItemAtIndex+](seq=code_block_49, indices=valueAtKey_14, replacement=firstItem_2)  # package Clockwork for Dynamo 2.x; Replaces the item at a given index of a list by another item. Unlike the OOTB node, it can replace items at multiple indeces.
code_block_52 = CodeBlock { "NonFixedPartIndex"; }
valueAtKey_16 = DesignScript.Builtin.Dictionary.ValueAtKey(dictionary=code_block_46, key=code_block_52)
code_block_53 = CodeBlock { "NonFixedPartPointIndex"; }
valueAtKey_17 = DesignScript.Builtin.Dictionary.ValueAtKey(dictionary=code_block_46, key=code_block_53)
replaceItemAtIndex_2 = Custom[List.ReplaceItemAtIndex+](seq=replaceItemAtIndex, indices=valueAtKey_16, replacement=valueAtKey_17)
point_index_list_추출 = Watch(replaceItemAtIndex_2)
code_block_54 = CodeBlock(TotalRoomPointIndexList=point_index_list_추출)
# ---------- code_block_54.designscript (3 lines) ----------
{
"TotalRoomPointIndexList": _TotalRoomPointIndexList
};
# ----------------------------------------
extendsChildDictionaryFromParent_8 = Custom[ExtendsChildDictionaryFromParent](ParentDic=code_block_46, ChildDic=code_block_54)

# group: Center Points
code_block_55 = CodeBlock(InputDic=extendsChildDictionaryFromParent_8.dictionary) { _InputDic; }
code_block_56 = CodeBlock { "GridPointOfBoundingBox"; }
valueAtKey_18 = DesignScript.Builtin.Dictionary.ValueAtKey(dictionary=code_block_55, key=code_block_56)
code_block_57 = CodeBlock { "TotalRoomPointIndexList"; }
valueAtKey_19 = DesignScript.Builtin.Dictionary.ValueAtKey(dictionary=code_block_55, key=code_block_57)
flatten_7 = List.Flatten(list=valueAtKey_19)
getItemAtIndex_13 = List.GetItemAtIndex(list=valueAtKey_18, index=flatten_7)
X_3 = Point.X(point=getItemAtIndex_13)
Y_3 = Point.Y(point=getItemAtIndex_13)
code_block_58 = CodeBlock { "ZvalueFromLevel"; }
valueAtKey_20 = DesignScript.Builtin.Dictionary.ValueAtKey(dictionary=code_block_55, key=code_block_58)
byCoordinates_2 = Point.ByCoordinates(x=X_3, y=Y_3, z=valueAtKey_20, lacing=Shortest)
code_block_59 = CodeBlock(TotalRoomCenterPoint=byCoordinates_2)
# ---------- code_block_59.designscript (3 lines) ----------
{
"TotalRoomCenterPoint": _TotalRoomCenterPoint
};
# ----------------------------------------
extendsChildDictionaryFromParent_9 = Custom[ExtendsChildDictionaryFromParent](ParentDic=code_block_55, ChildDic=code_block_59)

# group: Department 별 Boolean Index
code_block_60 = CodeBlock(InputDic=extendsChildDictionaryFromParent_9.dictionary) { _InputDic; }
code_block_61 = CodeBlock { "ExcelDataWithNoHead"; }
valueAtKey_21 = DesignScript.Builtin.Dictionary.ValueAtKey(dictionary=code_block_60, key=code_block_61)
code_block_62 = CodeBlock { 2; }
getItemAtIndex_14 = List.GetItemAtIndex(list=valueAtKey_21, index=code_block_62)
watch_8 = Watch(getItemAtIndex_14)
uniqueItems_5 = List.UniqueItems(list=watch_8)
eq_5 = uniqueItems_5 == watch_8  # lacing=CrossProduct
code_block_63 = CodeBlock(BlnIndexPerDepartment=eq_5)
# ---------- code_block_63.designscript (3 lines) ----------
{
"BlnIndexPerDepartment": _BlnIndexPerDepartment
};
# ----------------------------------------
extendsChildDictionaryFromParent_10 = Custom[ExtendsChildDictionaryFromParent](ParentDic=code_block_60, ChildDic=code_block_63)

# group: Department로 List 분류
code_block_64 = CodeBlock(InputDic=extendsChildDictionaryFromParent_10.dictionary) { _InputDic; }
code_block_65 = CodeBlock { "SpaceID"; }
valueAtKey_22 = DesignScript.Builtin.Dictionary.ValueAtKey(dictionary=code_block_64, key=code_block_65)
space_id_2 = Watch(valueAtKey_22)
code_block_66 = CodeBlock { "BlnIndexPerDepartment"; }
valueAtKey_23 = DesignScript.Builtin.Dictionary.ValueAtKey(dictionary=code_block_64, key=code_block_66)
filterByBoolMask_2 = List.FilterByBoolMask(list=space_id_2, mask=valueAtKey_23@L2)
watch_9 = Watch(filterByBoolMask_2.in)
code_block_67 = CodeBlock { "TotalRoomCenterPoint"; }
valueAtKey_24 = DesignScript.Builtin.Dictionary.ValueAtKey(dictionary=code_block_64, key=code_block_67)
filterByBoolMask_3 = List.FilterByBoolMask(list=valueAtKey_24, mask=valueAtKey_23@L2)
watch_10 = Watch(filterByBoolMask_3.in)
code_block_68 = CodeBlock { "Area"; }
valueAtKey_25 = DesignScript.Builtin.Dictionary.ValueAtKey(dictionary=code_block_64, key=code_block_68)
AREA_3 = Watch(valueAtKey_25)
code_block_69 = CodeBlock(a=AREA_3) { a/2; }
filterByBoolMask_4 = List.FilterByBoolMask(list=code_block_69, mask=valueAtKey_23@L2)
watch_11 = Watch(filterByBoolMask_4.in)
code_block_70 = CodeBlock(SpaceIDPerDepartment=watch_9, RoomCenterPointPerDe=watch_10, AreaPerDepartment=watch_11)
# ---------- code_block_70.designscript (5 lines) ----------
{
"SpaceIDPerDepartment": _SpaceIDPerDepartment,
"RoomCenterPointPerDepartment": _RoomCenterPointPerDepartment,
"AreaPerDepartment": _AreaPerDepartment
};
# ----------------------------------------
extendsChildDictionaryFromParent_11 = Custom[ExtendsChildDictionaryFromParent](ParentDic=code_block_64, ChildDic=code_block_70)

# group: ADJACENT SPACES 연결을 위한 List 정리 / Line 추출
code_block_71 = CodeBlock(InputDic=extendsChildDictionaryFromParent_11.dictionary) { _InputDic; }
code_block_72 = CodeBlock { "TotalRoomCenterPoint"; }
valueAtKey_26 = DesignScript.Builtin.Dictionary.ValueAtKey(dictionary=code_block_71, key=code_block_72)
flatten_8 = List.Flatten(list=valueAtKey_26)
정배열_points = Watch(flatten_8)
code_block_73 = CodeBlock { "SpaceID"; }
valueAtKey_27 = DesignScript.Builtin.Dictionary.ValueAtKey(dictionary=code_block_71, key=code_block_73)
space_id_3 = Watch(valueAtKey_27)
getItemAtIndex_15 = List.GetItemAtIndex(list=정배열_points, index=space_id_3)
code_block_74 = CodeBlock { "AdjacentSpaces"; }
valueAtKey_28 = DesignScript.Builtin.Dictionary.ValueAtKey(dictionary=code_block_71, key=code_block_74)
watch_12 = Watch(valueAtKey_28)
code_block_75 = CodeBlock { ","; }
split = String.Split(str=watch_12@L1, separator0=code_block_75)
flatten_9 = List.Flatten(list=split)
string_from_object_2 = FromObject(object=flatten_9)
adjacent_spaces_flatten = Watch(string_from_object_2)
toNumber = String.ToNumber(str=adjacent_spaces_flatten)
getItemAtIndex_16 = List.GetItemAtIndex(list=정배열_points, index=toNumber)
count_4 = List.Count(list=split@L2)
chop = List.Chop(list=getItemAtIndex_16, lengths=count_4)
byStartPointEndPoint = Line.ByStartPointEndPoint(startPoint=getItemAtIndex_15, endPoint=chop, lacing=Shortest)
code_block_76 = CodeBlock(AdjacentSpacesLine=byStartPointEndPoint)
# ---------- code_block_76.designscript (3 lines) ----------
{
"AdjacentSpacesLine": _AdjacentSpacesLine
};
# ----------------------------------------
extendsChildDictionaryFromParent_12 = Custom[ExtendsChildDictionaryFromParent](ParentDic=code_block_71, ChildDic=code_block_76)

# group: REC (사각형) 변경 전
code_block_77 = CodeBlock(InputDic=extendsChildDictionaryFromParent_12.dictionary) { _InputDic; }
code_block_78 = CodeBlock { "RoomCenterPointPerDepartment"; }
valueAtKey_29 = DesignScript.Builtin.Dictionary.ValueAtKey(dictionary=code_block_77, key=code_block_78)
code_block_79 = CodeBlock { "AreaPerDepartment"; }
valueAtKey_30 = DesignScript.Builtin.Dictionary.ValueAtKey(dictionary=code_block_77, key=code_block_79)
sqrt = Math.Sqrt(number=valueAtKey_30)
# note: 버블 다이어그램용 원
# (반지름 변경 전)
byCenterPointRadius = Circle.ByCenterPointRadius(centerPoint=valueAtKey_29, radius=sqrt)
radius = Circle.Radius(circle=byCenterPointRadius)
code_block_80 = CodeBlock(a=radius) { a*2; }
byWidthLength = Rectangle.ByWidthLength(width=code_block_80, length=code_block_80)
X_4 = Point.X(point=valueAtKey_29)
Y_4 = Point.Y(point=valueAtKey_29)
Z_2 = Point.Z(point=valueAtKey_29)
translate = Geometry.Translate(geometry=byWidthLength, xTranslation=X_4, yTranslation=Y_4, zTranslation=Z_2)
byPatch_2 = Surface.ByPatch(closedCurve=translate)
code_block_81 = CodeBlock(RoomRectangle=translate, RoomRectangleZvalue=Z_2, RoomRectangleSurface=byPatch_2)
# ---------- code_block_81.designscript (5 lines) ----------
{
"RoomRectangle": _RoomRectangle,
"RoomRectangleZvalue": _RoomRectangleZvalue,
"RoomRectangleSurface": _RoomRectangleSurface
};
# ----------------------------------------
extendsChildDictionaryFromParent_13 = Custom[ExtendsChildDictionaryFromParent](ParentDic=code_block_77, ChildDic=code_block_81)

# group: 부서별 색상 지정
code_block_82 = CodeBlock(InputDic=extendsChildDictionaryFromParent_13.dictionary) { _InputDic; }
code_block_83 = CodeBlock { "Department"; }
valueAtKey_31 = DesignScript.Builtin.Dictionary.ValueAtKey(dictionary=code_block_82, key=code_block_83)
watch_13 = Watch(valueAtKey_31)
uniqueItems_6 = List.UniqueItems(list=watch_13)
code_block_84 = CodeBlock()
# ---------- code_block_84.designscript (6 lines) ----------
color1 = Color.ByARGB(200, 100, 0, 200);
color2 = Color.ByARGB(200, 100, 200, 0);
color3 = Color.ByARGB(200, 200, 0, 0);
color4 = Color.ByARGB(200, 0, 0, 200);
color5 = Color.ByARGB(200, 200, 0, 100);
color6 = Color.ByARGB(200, 0, 200, 0);
# ----------------------------------------
remember_3 = Data.Remember(code_block_84.color1)
remember_4 = Data.Remember(code_block_84.color2)
remember_5 = Data.Remember(code_block_84.color3)
remember_6 = Data.Remember(code_block_84.color4)
remember_7 = Data.Remember(code_block_84.color5)
remember_8 = Data.Remember(code_block_84.color6)
join = List.Join(list0=remember_3, list1=remember_4, list2=remember_5, list3=remember_6, list4=remember_7, list5=remember_8)
byKeysValues_2 = DesignScript.Builtin.Dictionary.ByKeysValues(keys=uniqueItems_6, values=join)
code_block_85 = CodeBlock(DepartmentColorDic=byKeysValues_2)
# ---------- code_block_85.designscript (3 lines) ----------
{
"DepartmentColorDic": _DepartmentColorDic
};
# ----------------------------------------
extendsChildDictionaryFromParent_14 = Custom[ExtendsChildDictionaryFromParent](ParentDic=code_block_82, ChildDic=code_block_85)

# group: 사각 공간 색상 지정
code_block_86 = CodeBlock(InputDic=extendsChildDictionaryFromParent_14.dictionary) { _InputDic; }
code_block_87 = CodeBlock { "RoomRectangleSurface"; }
valueAtKey_32 = DesignScript.Builtin.Dictionary.ValueAtKey(dictionary=code_block_86, key=code_block_87)
code_block_88 = CodeBlock { "BoxHeight"; }
valueAtKey_33 = DesignScript.Builtin.Dictionary.ValueAtKey(dictionary=code_block_86, key=code_block_88)
boolean_3 = BoolSelector(false)
thicken = Surface.Thicken(surface=valueAtKey_32, thickness=valueAtKey_33, both_sides=boolean_3)
code_block_89 = CodeBlock { "DepartmentColorDic"; }
valueAtKey_34 = DesignScript.Builtin.Dictionary.ValueAtKey(dictionary=code_block_86, key=code_block_89)
code_block_90 = CodeBlock { "Department"; }
valueAtKey_35 = DesignScript.Builtin.Dictionary.ValueAtKey(dictionary=code_block_86, key=code_block_90)
code_block_91 = CodeBlock { "SpaceIDPerDepartment"; }
valueAtKey_36 = DesignScript.Builtin.Dictionary.ValueAtKey(dictionary=code_block_86, key=code_block_91)
flatten_10 = List.Flatten(list=valueAtKey_36)
getItemAtIndex_17 = List.GetItemAtIndex(list=valueAtKey_35, index=flatten_10)
valueAtKey_37 = DesignScript.Builtin.Dictionary.ValueAtKey(dictionary=valueAtKey_34, key=getItemAtIndex_17)
count_5 = List.Count(list=thicken@L2)
chop_2 = List.Chop(list=valueAtKey_37, lengths=count_5)
byGeometryColor = Modifiers.GeometryColor.ByGeometryColor(geometry=thicken, color=chop_2)
code_block_92 = CodeBlock(RoomSolid=thicken)
# ---------- code_block_92.designscript (3 lines) ----------
{
"RoomSolid": _RoomSolid
};
# ----------------------------------------
extendsChildDictionaryFromParent_15 = Custom[ExtendsChildDictionaryFromParent](ParentDic=code_block_86, ChildDic=code_block_92)

code_block_93 = CodeBlock { 1; }
getItemAtIndex_18 = List.GetItemAtIndex(list=watch@L2, index=code_block_93)
code_block_94 = CodeBlock { 1; }
getItemAtIndex_19 = List.GetItemAtIndex(list=watch, index=code_block_94)

# group: 삭제 예정
code_block_95 = CodeBlock {  }
code_block_96 = CodeBlock {  }

# group: GD Output - difference area to minimum
code_block_97 = CodeBlock(InputDic=extendsChildDictionaryFromParent_15.dictionary) { _InputDic; }
code_block_98 = CodeBlock { "RoomRectangle"; }
valueAtKey_38 = DesignScript.Builtin.Dictionary.ValueAtKey(dictionary=code_block_97, key=code_block_98)
flatten_11 = List.Flatten(list=valueAtKey_38)
code_block_99 = CodeBlock { "RoomRectangleZvalue"; }
valueAtKey_39 = DesignScript.Builtin.Dictionary.ValueAtKey(dictionary=code_block_97, key=code_block_99)
flatten_12 = List.Flatten(list=valueAtKey_39)
uniqueItems_7 = List.UniqueItems(list=flatten_12)
allIndicesOf_3 = List.AllIndicesOf(list=flatten_12, item=uniqueItems_7)
getItemAtIndex_20 = List.GetItemAtIndex(list=flatten_11, index=allIndicesOf_3)
code_block_100 = CodeBlock { "RoomBoundary"; }
valueAtKey_40 = DesignScript.Builtin.Dictionary.ValueAtKey(dictionary=code_block_97, key=code_block_100)
basePlane = PolyCurve.BasePlane(polyCurve=valueAtKey_40)
firstItem_3 = List.FirstItem(list=basePlane)
pullOntoPlane = Curve.PullOntoPlane(curve=getItemAtIndex_20, plane=firstItem_3)
byPatch_3 = Surface.ByPatch(closedCurve=pullOntoPlane)
split_2 = Geometry.Split(geometry=byPatch_3, other=valueAtKey_40)
code_block_101 = CodeBlock { 1; }
flatten_13 = List.Flatten(list=split_2@L2, amt=code_block_101)
flatten_14 = List.Flatten(list=flatten_13)
code_block_102 = CodeBlock { 10; }
offset = Curve.Offset(curve=valueAtKey_40, distance=code_block_102)
doesIntersect = Geometry.DoesIntersect(geometry=flatten_14@L2, other=offset@L1)
flatten_15 = List.Flatten(list=doesIntersect)
filterByBoolMask_5 = List.FilterByBoolMask(list=flatten_14, mask=flatten_15)
area = Surface.Area(surface=filterByBoolMask_5.in)
math_sum_outside_area_of = Math.Sum(values=area)  # "Math.Sum@Outside Area of Boundary"; graph output
byJoinedSurfaces = PolySurface.ByJoinedSurfaces()  # unwired: surfaces
byPatch_4 = Surface.ByPatch(closedCurve=valueAtKey_40)
firstItem_4 = List.FirstItem(list=byPatch_4)
