# Dynamo graph 0803 space planning test 004CN_mk.dyn (Dynamo 2.10.1.3976)
# packages: GenerativeDesign.Revit 1.7.3.0, GenerativeDesign 1.7.3.0, Clockwork for Dynamo 2.x 2.3.0

# group: User Inputs for GDIR
# note: Custom Package: GenerativeDesign v.2021.5.5
select_room_to_load_program_into = DSModelRoomSelection()  # 1 picked in the model; graph input
# note: Retrieve the room's finish boundary.
# Note: The first sublist is the outermost boundary of the room.
finishBoundary = Room.FinishBoundary(room=select_room_to_load_program_into)
remember = Data.Remember(finishBoundary)

# group: Extract room boundary for DynaSpace and cache it in the graph
firstItem = List.FirstItem(list=remember@L3)
startPoint = Curve.StartPoint(curve=firstItem)
flatten = List.Flatten(list=startPoint)
byJoinedCurves = PolyCurve.ByJoinedCurves(curves=firstItem)
code_block = CodeBlock(RoomBoundary=byJoinedCurves)
# ---------- code_block.designscript (3 lines) ----------
{
"RoomBoundary": _RoomBoundary
};
# ----------------------------------------

# group: Excel Data import (package 정리 전)
file_path = Filename(".\space planning test 0802mk 001.xlsx")
file_from_path = FileObject(path=file_path)
string_from_object = FromObject(object=file_from_path)
code_block_2 = CodeBlock { "Sheet1"; "SampleBuildingProgram-Clinic"; false; }
python_script_import_excel_by = Python(IN[0]=string_from_object, IN[1]=code_block_2.out0)  # "Python Script@Import Excel(By OpenpyXl)"; CPython3
# ---------- python_script_import_excel_by.python (50 lines) ----------
# Load the Python Standard and DesignScript Libraries
import sys
import os
#sys.path.append(r'C:\Users\HEC\AppData\Local\Programs\Python\Python39\Lib\site-packages')
#sys.path.append(r'C:\Users\pjmk0\AppData\Local\Programs\Python\Python39\Lib\site-packages')
sys.path.append(os.getenv('LOCALAPPDATA').replace('\\','\\\\') + r'\Programs\Python\Python39\Lib\site-packages')
import clr
clr.AddReference('ProtoGeometry')
from Autodesk.DesignScript.Geometry import *
from collections import Iterable

def iterable(obj):
    return isinstance(obj, Iterable)


# The inputs to this node will be stored as a list in the IN variables.
dataEnteringNode = IN
PathIn = IN[0]
SheetNameIn = IN[1]

# Place your code below this line
import datetime
import openpyxl

path = (PathIn)
#path = (r'C:\Users\pjmk0\Downloads\MK\mQ\BIM_물량집계 자동화 산출기준표_rC(20210607)_mk_de.xlsx')

wb_obj = openpyxl.load_workbook(path, data_only=True)
sheet_obj = wb_obj.get_sheet_by_name(SheetNameIn)

m_row = sheet_obj.max_row
m_col = sheet_obj.max_column

listOut = []



for i in range(1, m_row +1):
    listTemp = []
    for j in range(1, m_col + 1):
        cell_obj = sheet_obj.cell(row=i, column=j)
        listTemp.append(cell_obj.value)
        if len(listTemp) == m_col:
            listOut.append(listTemp)
        


# Assign your output to the OUT variable.
OUT = listOut
#OUT = os.getenv('APPDATA')
# ----------------------------------------
excel_data_정리_전 = Watch(python_script_import_excel_by)

remember_2 = Data.Remember(excel_data_정리_전)

# group: 고정부 Seed
seed_고정부_코어 = DoubleSlider(660, range=0..999 step 1)  # graph input

# group: 변동부 Seed
seed_변형부_공간 = DoubleSlider(263, range=0..999 step 1)  # graph input

# group: Lev 높이
number = DoubleInput(2000)

code_block_3 = CodeBlock(FixedPartSeed=seed_고정부_코어, NonFixedPartSeed=seed_변형부_공간, BoxHeight=number)
# ---------- code_block_3.designscript (5 lines) ----------
{
"FixedPartSeed": _FixedPartSeed,
"NonFixedPartSeed": _NonFixedPartSeed,
"BoxHeight": _BoxHeight
};
# ----------------------------------------
extendsChildDictionaryFromParent = Custom[ExtendsChildDictionaryFromParent](ParentDic=code_block, ChildDic=code_block_3)  # Extends Child Dictionary From Parent

# group: Excel List 분할
excel_data_정리_전_2 = Watch(remember_2)
transpose = List.Transpose(lists=excel_data_정리_전_2)
code_block_4 = CodeBlock { 1; }
# note: List Name 정리
dropItems = List.DropItems(list=transpose@L2, amount=code_block_4)
watch = Watch(dropItems)
code_block_5 = CodeBlock { 0; }
getItemAtIndex = List.GetItemAtIndex(list=watch, index=code_block_5)
space_id = Watch(getItemAtIndex)
code_block_6 = CodeBlock { 1; }
getItemAtIndex_2 = List.GetItemAtIndex(list=watch, index=code_block_6)
space_name = Watch(getItemAtIndex_2)
code_block_7 = CodeBlock { 10; }
getItemAtIndex_3 = List.GetItemAtIndex(list=watch, index=code_block_7)
adjacent_spaces = Watch(getItemAtIndex_3)
code_block_8 = CodeBlock { 3; }
getItemAtIndex_4 = List.GetItemAtIndex(list=watch, index=code_block_8)
department_id = Watch(getItemAtIndex_4)
code_block_9 = CodeBlock { 2; }
getItemAtIndex_5 = List.GetItemAtIndex(list=watch, index=code_block_9)
DEPARTMENT = Watch(getItemAtIndex_5)
code_block_10 = CodeBlock { 11; }
getItemAtIndex_6 = List.GetItemAtIndex(list=watch, index=code_block_10)
AREA = Watch(getItemAtIndex_6)
code_block_11 = CodeBlock { 5; }
getItemAtIndex_7 = List.GetItemAtIndex(list=watch, index=code_block_11)
WIDTH = Watch(getItemAtIndex_7)
code_block_12 = CodeBlock { 6; }
getItemAtIndex_8 = List.GetItemAtIndex(list=watch, index=code_block_12)
length = Watch(getItemAtIndex_8)
code_block_13 = CodeBlock { 7; }
getItemAtIndex_9 = List.GetItemAtIndex(list=watch, index=code_block_13)
AREA_2 = Watch(getItemAtIndex_9)
code_block_14 = CodeBlock(ExcelDataWithNoHead=watch, SpaceID=space_id, SpaceName=space_name, AdjacentSpaces=adjacent_spaces, DepartmentID=department_id, Department=DEPARTMENT, Level=AREA, Width=WIDTH, Length=length, Area=AREA_2, AdjacentDepartments=AREA)
# ---------- code_block_14.designscript (13 lines) ----------
{
"ExcelDataWithNoHead": _ExcelDataWithNoHead,
"SpaceID": _SpaceID,
"SpaceName": _SpaceName,
"AdjacentSpaces": _AdjacentSpaces,
"DepartmentID": _DepartmentID,
"Department": _Department,
"Level": _Level,
"Width": _Width,
"Length": _Length,
"Area": _Area,
"AdjacentDepartments": _AdjacentDepartments
};
# ----------------------------------------
extendsChildDictionaryFromParent_2 = Custom[ExtendsChildDictionaryFromParent](ParentDic=code_block_14, ChildDic=extendsChildDictionaryFromParent.dictionary)
lastItem = List.LastItem(list=watch)
lev = Watch(lastItem)

# group: Level에 따라 Z 값 Dictionary 추출
code_block_15 = CodeBlock(InputDic=extendsChildDictionaryFromParent_2.dictionary) { _InputDic; }
code_block_16 = CodeBlock { "Level"; }
valueAtKey = DesignScript.Builtin.Dictionary.ValueAtKey(dictionary=code_block_15, key=code_block_16)
lev_2 = Watch(valueAtKey)
uniqueItems = List.UniqueItems(list=lev_2)
code_block_17 = CodeBlock { -2000..4000..2000; }
byKeysValues = DesignScript.Builtin.Dictionary.ByKeysValues(keys=uniqueItems, values=code_block_17)
watch_2 = Watch(byKeysValues)
valueAtKey_2 = DesignScript.Builtin.Dictionary.ValueAtKey(dictionary=watch_2, key=lev_2)
z_값_lev_에서_추출 = Watch(valueAtKey_2)
code_block_18 = CodeBlock(ZvalueFromLevel=z_값_lev_에서_추출)
# ---------- code_block_18.designscript (3 lines) ----------
{
"ZvalueFromLevel": _ZvalueFromLevel
};
# ----------------------------------------
extendsChildDictionaryFromParent_3 = Custom[ExtendsChildDictionaryFromParent](ParentDic=code_block_15, ChildDic=code_block_18)

# group: 룸 BoundingBox 포인트 추출
code_block_19 = CodeBlock(InputDic=extendsChildDictionaryFromParent_3.dictionary) { _InputDic; }
code_block_20 = CodeBlock { "RoomBoundary"; }
valueAtKey_3 = DesignScript.Builtin.Dictionary.ValueAtKey(dictionary=code_block_19, key=code_block_20)
byGeometry = BoundingBox.ByGeometry(geom=valueAtKey_3)
minPoint = BoundingBox.MinPoint(boundingBox=byGeometry)
X = Point.X(point=minPoint)
maxPoint = BoundingBox.MaxPoint(boundingBox=byGeometry)
X_2 = Point.X(point=maxPoint)
code_block_21 = CodeBlock { 500; }
code_block_22 = CodeBlock(a=X, b=X_2, x=code_block_21) { a..b..x; }
Y = Point.Y(point=minPoint)
Y_2 = Point.Y(point=maxPoint)
code_block_23 = CodeBlock { 500; }
code_block_24 = CodeBlock(a=Y, b=Y_2, x=code_block_23) { a..b..x; }
byCoordinates = Point.ByCoordinates(x=code_block_22, y=code_block_24, lacing=CrossProduct)
flatten_2 = List.Flatten(list=byCoordinates)
code_block_25 = CodeBlock(GridPointOfBoundingBox=flatten_2)
# ---------- code_block_25.designscript (3 lines) ----------
{
"GridPointOfBoundingBox": _GridPointOfBoundingBox
};
# ----------------------------------------
extendsChildDictionaryFromParent_4 = Custom[ExtendsChildDictionaryFromParent](ParentDic=code_block_19, ChildDic=code_block_25)

# group: 고정부/변동부 구별
code_block_26 = CodeBlock(InputDic=extendsChildDictionaryFromParent_4.dictionary) { _InputDic; }
code_block_27 = CodeBlock { "DepartmentID"; }
valueAtKey_4 = DesignScript.Builtin.Dictionary.ValueAtKey(dictionary=code_block_26, key=code_block_27)
department_id_2 = Watch(valueAtKey_4)
# note: 3 = Path V = 계단
code_block_28 = CodeBlock { [3,5,6]; }
eq = department_id_2 == code_block_28@L1
boolean = BoolSelector(true)
allIndicesOf = List.AllIndicesOf(list=eq@L2, item=boolean)
boolean_2 = BoolSelector(false)
allIndicesOf_2 = List.AllIndicesOf(list=eq@L2, item=boolean_2)
flatten_3 = List.Flatten(list=allIndicesOf_2)
uniqueItems_2 = List.UniqueItems(list=flatten_3)
flatten_4 = List.Flatten(list=allIndicesOf)
setDifference = List.SetDifference(list1=uniqueItems_2, list2=flatten_4)
code_block_29 = CodeBlock(FixedPartIndex=allIndicesOf, NonFixedPartIndex=setDifference)
# ---------- code_block_29.designscript (4 lines) ----------
{
"FixedPartIndex": _FixedPartIndex,
"NonFixedPartIndex": _NonFixedPartIndex
};
# ----------------------------------------
extendsChildDictionaryFromParent_5 = Custom[ExtendsChildDictionaryFromParent](ParentDic=code_block_26, ChildDic=code_block_29)

# group: 층별 고정부 Point Index 추출
code_block_30 = CodeBlock(InputDic=extendsChildDictionaryFromParent_5.dictionary) { _InputDic; }
ofRepeatedItem = List.OfRepeatedItem()  # unwired: item, amount
code_block_31 = CodeBlock { "Level"; }
valueAtKey_5 = DesignScript.Builtin.Dictionary.ValueAtKey(dictionary=code_block_30, key=code_block_31)
code_block_32 = CodeBlock { "FixedPartIndex"; }
valueAtKey_6 = DesignScript.Builtin.Dictionary.ValueAtKey(dictionary=code_block_30, key=code_block_32)
getItemAtIndex_10 = List.GetItemAtIndex(list=valueAtKey_5, index=valueAtKey_6)
uniqueItems_3 = List.UniqueItems(list=getItemAtIndex_10@L2)
count = List.Count(list=uniqueItems_3@L3)
code_block_33 = CodeBlock { 0; }
code_block_34 = CodeBlock { "GridPointOfBoundingBox"; }
valueAtKey_7 = DesignScript.Builtin.Dictionary.ValueAtKey(dictionary=code_block_30, key=code_block_34)
count_2 = List.Count(list=valueAtKey_7)
watch_3 = Watch(count_2)
code_block_35 = CodeBlock { "FixedPartSeed"; }
valueAtKey_8 = DesignScript.Builtin.Dictionary.ValueAtKey(dictionary=code_block_30, key=code_block_35)
randomList = Math.RandomList(amount=count, value1=code_block_33, value2=watch_3, seed=valueAtKey_8)
flatten_5 = List.Flatten(list=randomList)
count_3 = List.Count(list=uniqueItems_3@L2)
laceShortest = List.LaceShortest(combineFunction=ofRepeatedItem, list0=flatten_5, list1=count_3)
watch_4 = Watch(laceShortest)
round = Math.Round(number=watch_4)
code_block_36 = CodeBlock(FixedPartPointIndex=round)
# ---------- code_block_36.designscript (3 lines) ----------
{
"FixedPartPointIndex": _FixedPartPointIndex
};
# ----------------------------------------
extendsChildDictionaryFromParent_6 = Custom[ExtendsChildDictionaryFromParent](ParentDic=code_block_30, ChildDic=code_block_36)

# group: 층별 변동부 Point Index 추출
code_block_37 = CodeBlock(InputDic=extendsChildDictionaryFromParent_6.dictionary) { _InputDic; }
code_block_38 = CodeBlock { "Level"; }
valueAtKey_9 = DesignScript.Builtin.Dictionary.ValueAtKey(dictionary=code_block_37, key=code_block_38)
code_block_39 = CodeBlock { "NonFixedPartIndex"; }
valueAtKey_10 = DesignScript.Builtin.Dictionary.ValueAtKey(dictionary=code_block_37, key=code_block_39)
getItemAtIndex_11 = List.GetItemAtIndex(list=valueAtKey_9, index=valueAtKey_10)
uniqueItems_4 = List.UniqueItems(list=getItemAtIndex_11)
eq_2 = uniqueItems_4 == getItemAtIndex_11  # lacing=CrossProduct
countTrue = List.CountTrue(list=eq_2@L2)
sum = Math.Sum(values=countTrue)
code_block_40 = CodeBlock { 0; }
code_block_41 = CodeBlock { "GridPointOfBoundingBox"; }
valueAtKey_11 = DesignScript.Builtin.Dictionary.ValueAtKey(dictionary=code_block_37, key=code_block_41)
count_4 = List.Count(list=valueAtKey_11)
watch_5 = Watch(count_4)
code_block_42 = CodeBlock { "NonFixedPartSeed"; }
valueAtKey_12 = DesignScript.Builtin.Dictionary.ValueAtKey(dictionary=code_block_37, key=code_block_42)
randomList_2 = Math.RandomList(amount=sum, value1=code_block_40, value2=watch_5, seed=valueAtKey_12)
watch_6 = Watch(randomList_2)
round_2 = Math.Round(number=watch_6)
code_block_43 = CodeBlock(NonFixedPartPointIndex=round_2)
# ---------- code_block_43.designscript (3 lines) ----------
{
"NonFixedPartPointIndex": _NonFixedPartPointIndex
};
# ----------------------------------------
extendsChildDictionaryFromParent_7 = Custom[ExtendsChildDictionaryFromParent](ParentDic=code_block_37, ChildDic=code_block_43)

# group: Total Room Point Index List 추출
code_block_44 = CodeBlock(InputDic=extendsChildDictionaryFromParent_7.dictionary) { _InputDic; }
code_block_45 = CodeBlock { "DepartmentID"; }
valueAtKey_13 = DesignScript.Builtin.Dictionary.ValueAtKey(dictionary=code_block_44, key=code_block_45)
count_5 = List.Count(list=valueAtKey_13)
code_block_46 = CodeBlock(a=count_5) { a-1; }
code_block_47 = CodeBlock(a=code_block_46) { 0..a..1; }
code_block_48 = CodeBlock { "FixedPartIndex"; }
valueAtKey_14 = DesignScript.Builtin.Dictionary.ValueAtKey(dictionary=code_block_44, key=code_block_48)
code_block_49 = CodeBlock { "FixedPartPointIndex"; }
valueAtKey_15 = DesignScript.Builtin.Dictionary.ValueAtKey(dictionary=code_block_44, key=code_block_49)
replaceItemAtIndex = Custom[List.ReplaceItemAtIndex+](seq=code_block_47, indices=valueAtKey_14, replacement=valueAtKey_15)  # package Clockwork for Dynamo 2.x; Replaces the item at a given index of a list by another item. Unlike the OOTB node, it can replace items at multiple indeces.
code_block_50 = CodeBlock { "NonFixedPartIndex"; }
valueAtKey_16 = DesignScript.Builtin.Dictionary.ValueAtKey(dictionary=code_block_44, key=code_block_50)
code_block_51 = CodeBlock { "NonFixedPartPointIndex"; }
valueAtKey_17 = DesignScript.Builtin.Dictionary.ValueAtKey(dictionary=code_block_44, key=code_block_51)
replaceItemAtIndex_2 = Custom[List.ReplaceItemAtIndex+](seq=replaceItemAtIndex, indices=valueAtKey_16, replacement=valueAtKey_17)
point_index_list_추출 = Watch(replaceItemAtIndex_2)
code_block_52 = CodeBlock(TotalRoomPointIndexList=point_index_list_추출)
# ---------- code_block_52.designscript (3 lines) ----------
{
"TotalRoomPointIndexList": _TotalRoomPointIndexList
};
# ----------------------------------------
extendsChildDictionaryFromParent_8 = Custom[ExtendsChildDictionaryFromParent](ParentDic=code_block_44, ChildDic=code_block_52)
firstItem_2 = List.FirstItem(list=valueAtKey_15@L2)

# group: Center Points
code_block_53 = CodeBlock(InputDic=extendsChildDictionaryFromParent_8.dictionary) { _InputDic; }
code_block_54 = CodeBlock { "GridPointOfBoundingBox"; }
valueAtKey_18 = DesignScript.Builtin.Dictionary.ValueAtKey(dictionary=code_block_53, key=code_block_54)
code_block_55 = CodeBlock { "TotalRoomPointIndexList"; }
valueAtKey_19 = DesignScript.Builtin.Dictionary.ValueAtKey(dictionary=code_block_53, key=code_block_55)
flatten_6 = List.Flatten(list=valueAtKey_19)
getItemAtIndex_12 = List.GetItemAtIndex(list=valueAtKey_18, index=flatten_6)
X_3 = Point.X(point=getItemAtIndex_12)
Y_3 = Point.Y(point=getItemAtIndex_12)
code_block_56 = CodeBlock { "ZvalueFromLevel"; }
valueAtKey_20 = DesignScript.Builtin.Dictionary.ValueAtKey(dictionary=code_block_53, key=code_block_56)
byCoordinates_2 = Point.ByCoordinates(x=X_3, y=Y_3, z=valueAtKey_20, lacing=Shortest)
code_block_57 = CodeBlock(TotalRoomCenterPoint=byCoordinates_2)
# ---------- code_block_57.designscript (3 lines) ----------
{
"TotalRoomCenterPoint": _TotalRoomCenterPoint
};
# ----------------------------------------
extendsChildDictionaryFromParent_9 = Custom[ExtendsChildDictionaryFromParent](ParentDic=code_block_53, ChildDic=code_block_57)

# group: Department 별 Boolean Index
code_block_58 = CodeBlock(InputDic=extendsChildDictionaryFromParent_9.dictionary) { _InputDic; }
code_block_59 = CodeBlock { "ExcelDataWithNoHead"; }
valueAtKey_21 = DesignScript.Builtin.Dictionary.ValueAtKey(dictionary=code_block_58, key=code_block_59)
code_block_60 = CodeBlock { 2; }
getItemAtIndex_13 = List.GetItemAtIndex(list=valueAtKey_21, index=code_block_60)
watch_7 = Watch(getItemAtIndex_13)
uniqueItems_5 = List.UniqueItems(list=watch_7)
eq_3 = uniqueItems_5 == watch_7  # lacing=CrossProduct
code_block_61 = CodeBlock(BlnIndexPerDepartment=eq_3)
# ---------- code_block_61.designscript (3 lines) ----------
{
"BlnIndexPerDepartment": _BlnIndexPerDepartment
};
# ----------------------------------------
extendsChildDictionaryFromParent_10 = Custom[ExtendsChildDictionaryFromParent](ParentDic=code_block_58, ChildDic=code_block_61)

# group: Department로 List 분류-1
code_block_62 = CodeBlock(InputDic=extendsChildDictionaryFromParent_10.dictionary) { _InputDic; }
code_block_63 = CodeBlock { "SpaceID"; }
valueAtKey_22 = DesignScript.Builtin.Dictionary.ValueAtKey(dictionary=code_block_62, key=code_block_63)
space_id_2 = Watch(valueAtKey_22)
code_block_64 = CodeBlock { "BlnIndexPerDepartment"; }
valueAtKey_23 = DesignScript.Builtin.Dictionary.ValueAtKey(dictionary=code_block_62, key=code_block_64)
filterByBoolMask = List.FilterByBoolMask(list=space_id_2, mask=valueAtKey_23@L2)
watch_8 = Watch(filterByBoolMask.in)
code_block_65 = CodeBlock { "TotalRoomCenterPoint"; }
valueAtKey_24 = DesignScript.Builtin.Dictionary.ValueAtKey(dictionary=code_block_62, key=code_block_65)
filterByBoolMask_2 = List.FilterByBoolMask(list=valueAtKey_24, mask=valueAtKey_23@L2)
watch_9 = Watch(filterByBoolMask_2.in)
code_block_66 = CodeBlock { "Area"; }
valueAtKey_25 = DesignScript.Builtin.Dictionary.ValueAtKey(dictionary=code_block_62, key=code_block_66)
AREA_3 = Watch(valueAtKey_25)
code_block_67 = CodeBlock(a=AREA_3) { a/2; }
filterByBoolMask_3 = List.FilterByBoolMask(list=code_block_67, mask=valueAtKey_23@L2)
watch_10 = Watch(filterByBoolMask_3.in)
code_block_68 = CodeBlock(SpaceIDPerDepartment=watch_8, RoomCenterPointPerDe=watch_9, AreaPerDepartment=watch_10)
# ---------- code_block_68.designscript (5 lines) ----------
{
"SpaceIDPerDepartment": _SpaceIDPerDepartment,
"RoomCenterPointPerDepartment": _RoomCenterPointPerDepartment,
"AreaPerDepartment": _AreaPerDepartment
};
# ----------------------------------------
extendsChildDictionaryFromParent_11 = Custom[ExtendsChildDictionaryFromParent](ParentDic=code_block_62, ChildDic=code_block_68)

code_block_69 = CodeBlock(InputDic=extendsChildDictionaryFromParent_11.dictionary) { _InputDic; }
code_block_70 = CodeBlock { "Department"; }
valueAtKey_26 = DesignScript.Builtin.Dictionary.ValueAtKey(dictionary=code_block_69, key=code_block_70)
watch_11 = Watch(valueAtKey_26)
uniqueItems_6 = List.UniqueItems(list=watch_11)
code_block_71 = CodeBlock { "PATH"; }
contains = String.Contains(str=uniqueItems_6, searchFor=code_block_71)
boolean_3 = BoolSelector(true)
allIndicesOf_3 = List.AllIndicesOf(list=contains, item=boolean_3)
boolean_4 = BoolSelector(false)
allIndicesOf_4 = List.AllIndicesOf(list=contains, item=boolean_4)
join = List.Join(list0=allIndicesOf_3, list1=allIndicesOf_4)
watch_12 = Watch(join)
string_from_object_2 = FromObject(object=watch_12)
code_block_72 = CodeBlock { "RoomCenterPointPerDepartment"; }
valueAtKey_27 = DesignScript.Builtin.Dictionary.ValueAtKey(dictionary=code_block_69, key=code_block_72)
watch_13 = Watch(valueAtKey_27)
filterByBoolMask_4 = List.FilterByBoolMask(list=watch_13, mask=contains)
watch_14 = Watch(filterByBoolMask_4.in)
watch_15 = Watch(filterByBoolMask_4.out)

# group: 고정부 제외 POINT Z 값으로 정렬
flatten_7 = List.Flatten(list=watch_15)
Z = Point.Z(point=flatten_7)
uniqueItems_7 = List.UniqueItems(list=Z)
eq_4 = uniqueItems_7 == Z  # lacing=CrossProduct
filterByBoolMask_5 = List.FilterByBoolMask(list=flatten_7, mask=eq_4@L2)
watch_16 = Watch(filterByBoolMask_5.in)

# group: Cluster 재배열용 바운딩 박스 형성
watch_17 = Watch(watch_16)
X_4 = Point.X()  # unwired: point
minimumItemByKey = List.MinimumItemByKey(list=watch_17@L2, keyFunction=X_4)
watch_18 = Watch(minimumItemByKey)
X_5 = Point.X(point=watch_18)
Y_4 = Point.Y()  # unwired: point
minimumItemByKey_2 = List.MinimumItemByKey(list=watch_17@L2, keyFunction=Y_4)
watch_19 = Watch(minimumItemByKey_2)
Y_5 = Point.Y(point=watch_19)
maximumItemByKey = List.MaximumItemByKey(list=watch_17@L2, keyFunction=X_4)
watch_20 = Watch(maximumItemByKey)
Z_2 = Point.Z(point=watch_20)
byCoordinates_3 = Point.ByCoordinates(x=X_5, y=Y_5, z=Z_2)
X_6 = Point.X(point=watch_20)
maximumItemByKey_2 = List.MaximumItemByKey(list=watch_17@L2, keyFunction=Y_4)
watch_21 = Watch(maximumItemByKey_2)
Y_6 = Point.Y(point=watch_21)
byCoordinates_4 = Point.ByCoordinates(x=X_6, y=Y_6, z=Z_2)
byCorners = BoundingBox.ByCorners(min=byCoordinates_3, max=byCoordinates_4)
toCuboid = BoundingBox.ToCuboid(boundingBox=byCorners)
explode = Geometry.Explode(geometry=toCuboid)

code_block_73 = CodeBlock { 1; }
flatten_8 = List.Flatten(list=explode, amt=code_block_73)
code_block_74 = CodeBlock { 0..1..0.1; }
pointAtParameter = Surface.PointAtParameter(surface=flatten_8, u=code_block_74, v=code_block_74, lacing=CrossProduct)
code_block_75 = CodeBlock { 1; }
flatten_9 = List.Flatten(list=pointAtParameter@L3, amt=code_block_75)
watch_22 = Watch(flatten_9)
count_6 = List.Count(list=watch_17@L2)
code_block_76 = CodeBlock { 0; }
count_7 = List.Count(list=flatten_9@L2)
firstItem_3 = List.FirstItem(list=count_7)
seed_3 = DoubleSlider(72.2, range=0..100 step 0.1)  # graph input
randomList_3 = Math.RandomList(amount=count_6@L2, value1=code_block_76, value2=firstItem_3, seed=seed_3)
round_3 = Math.Round(number=randomList_3)
watch_23 = Watch(round_3)
code_block_77 = CodeBlock { 1; }
flatten_10 = List.Flatten(list=watch_23, amt=code_block_77)
getItemAtIndex_14 = List.GetItemAtIndex(list=watch_22@L2, index=flatten_10@L2)
watch_24 = Watch(getItemAtIndex_14)
isNull = Object.IsNull(object=watch_24)
boolean_5 = BoolSelector(true)
allIndicesOf_5 = List.AllIndicesOf(list=isNull@L1, item=boolean_5)
clean = List.Clean(list=allIndicesOf_5@L1)
getItemAtIndex_15 = List.GetItemAtIndex(list=watch_16@L3, index=clean)
flatten_11 = List.Flatten(list=getItemAtIndex_15)
replaceItemAtIndex_3 = List.ReplaceItemAtIndex(list=watch_24, index=clean, item=flatten_11)
code_block_78 = CodeBlock { 2; }
flatten_12 = List.Flatten(list=replaceItemAtIndex_3, amt=code_block_78)
flatten_13 = List.Flatten(list=flatten_12)
boolean_6 = BoolSelector(true)
allIndicesOf_6 = List.AllIndicesOf(list=eq_4@L2, item=boolean_6)
flatten_14 = List.Flatten(list=allIndicesOf_6)
getItemAtIndex_16 = List.GetItemAtIndex(list=flatten_13, index=flatten_14)
count_8 = List.Count(list=watch_15@L2)
chop = List.Chop(list=getItemAtIndex_16, lengths=count_8)
watch_25 = Watch(chop)
watch_26 = Watch(watch_25)
join_2 = List.Join(list0=watch_14, list1=watch_26)
byKeysValues_2 = DesignScript.Builtin.Dictionary.ByKeysValues(keys=string_from_object_2, values=join_2)
count_9 = List.Count(list=uniqueItems_6)
code_block_79 = CodeBlock(A=count_9) { 0..(A-1)..1; }
string_from_object_3 = FromObject(object=code_block_79)
valueAtKey_28 = DesignScript.Builtin.Dictionary.ValueAtKey(dictionary=byKeysValues_2, key=string_from_object_3)
watch_27 = Watch(valueAtKey_28)
watch_28 = Watch(watch_27)

# group: Department로 List 분류-2
code_block_80 = CodeBlock(InputDic=extendsChildDictionaryFromParent_10.dictionary) { _InputDic; }
code_block_81 = CodeBlock { "SpaceID"; }
valueAtKey_29 = DesignScript.Builtin.Dictionary.ValueAtKey(dictionary=code_block_80, key=code_block_81)
space_id_3 = Watch(valueAtKey_29)
code_block_82 = CodeBlock { "BlnIndexPerDepartment"; }
valueAtKey_30 = DesignScript.Builtin.Dictionary.ValueAtKey(dictionary=code_block_80, key=code_block_82)
filterByBoolMask_6 = List.FilterByBoolMask(list=space_id_3, mask=valueAtKey_30@L2)
watch_29 = Watch(filterByBoolMask_6.in)
code_block_83 = CodeBlock { "Area"; }
valueAtKey_31 = DesignScript.Builtin.Dictionary.ValueAtKey(dictionary=code_block_80, key=code_block_83)
AREA_4 = Watch(valueAtKey_31)
code_block_84 = CodeBlock(a=AREA_4) { a/2; }
filterByBoolMask_7 = List.FilterByBoolMask(list=code_block_84, mask=valueAtKey_30@L2)
watch_30 = Watch(filterByBoolMask_7.in)
code_block_85 = CodeBlock(SpaceIDPerDepartment=watch_29, RoomCenterPointPerDe=watch_28, AreaPerDepartment=watch_30)  # same code as code_block_68
extendsChildDictionaryFromParent_12 = Custom[ExtendsChildDictionaryFromParent](ParentDic=code_block_80, ChildDic=code_block_85)
code_block_86 = CodeBlock { "TotalRoomCenterPoint"; }
valueAtKey_32 = DesignScript.Builtin.Dictionary.ValueAtKey(dictionary=code_block_80, key=code_block_86)
filterByBoolMask_8 = List.FilterByBoolMask(list=valueAtKey_32, mask=valueAtKey_30@L2)
watch_31 = Watch(filterByBoolMask_8.in)

# group: ADJACENT SPACES 연결을 위한 List 정리 / Line 추출
code_block_87 = CodeBlock(InputDic=extendsChildDictionaryFromParent_12.dictionary) { _InputDic; }
code_block_88 = CodeBlock { "TotalRoomCenterPoint"; }
valueAtKey_33 = DesignScript.Builtin.Dictionary.ValueAtKey(dictionary=code_block_87, key=code_block_88)
flatten_15 = List.Flatten(list=valueAtKey_33)
정배열_points = Watch(flatten_15)
code_block_89 = CodeBlock { "SpaceID"; }
valueAtKey_34 = DesignScript.Builtin.Dictionary.ValueAtKey(dictionary=code_block_87, key=code_block_89)
space_id_4 = Watch(valueAtKey_34)
getItemAtIndex_17 = List.GetItemAtIndex(list=정배열_points, index=space_id_4)
code_block_90 = CodeBlock { "AdjacentSpaces"; }
valueAtKey_35 = DesignScript.Builtin.Dictionary.ValueAtKey(dictionary=code_block_87, key=code_block_90)
watch_32 = Watch(valueAtKey_35)
code_block_91 = CodeBlock { ","; }
split = String.Split(str=watch_32@L1, separator0=code_block_91)
flatten_16 = List.Flatten(list=split)
string_from_object_4 = FromObject(object=flatten_16)
adjacent_spaces_flatten = Watch(string_from_object_4)
toNumber = String.ToNumber(str=adjacent_spaces_flatten)
getItemAtIndex_18 = List.GetItemAtIndex(list=정배열_points, index=toNumber)
count_10 = List.Count(list=split@L2)
chop_2 = List.Chop(list=getItemAtIndex_18, lengths=count_10)
byStartPointEndPoint = Line.ByStartPointEndPoint(startPoint=getItemAtIndex_17, endPoint=chop_2, lacing=Shortest)
code_block_92 = CodeBlock(AdjacentSpacesLine=byStartPointEndPoint)
# ---------- code_block_92.designscript (3 lines) ----------
{
"AdjacentSpacesLine": _AdjacentSpacesLine
};
# ----------------------------------------
extendsChildDictionaryFromParent_13 = Custom[ExtendsChildDictionaryFromParent](ParentDic=code_block_87, ChildDic=code_block_92)

# group: REC (사각형) 변경 전
code_block_93 = CodeBlock(InputDic=extendsChildDictionaryFromParent_13.dictionary) { _InputDic; }
code_block_94 = CodeBlock { "RoomCenterPointPerDepartment"; }
valueAtKey_36 = DesignScript.Builtin.Dictionary.ValueAtKey(dictionary=code_block_93, key=code_block_94)
code_block_95 = CodeBlock { "AreaPerDepartment"; }
valueAtKey_37 = DesignScript.Builtin.Dictionary.ValueAtKey(dictionary=code_block_93, key=code_block_95)

code_block_96 = CodeBlock { "Length"; "Width"; }
valueAtKey_38 = DesignScript.Builtin.Dictionary.ValueAtKey(dictionary=code_block_93, key=code_block_96.out0)
code_block_97 = CodeBlock { "SpaceIDPerDepartment"; }
valueAtKey_39 = DesignScript.Builtin.Dictionary.ValueAtKey(dictionary=code_block_93, key=code_block_97)
flatten_17 = List.Flatten(list=valueAtKey_39)
getItemAtIndex_19 = List.GetItemAtIndex(list=valueAtKey_38, index=flatten_17)
valueAtKey_40 = DesignScript.Builtin.Dictionary.ValueAtKey(dictionary=code_block_93, key=code_block_96.out1)
getItemAtIndex_20 = List.GetItemAtIndex(list=valueAtKey_40, index=flatten_17)

# group (continued): REC (사각형) 변경 전
byWidthLength = Rectangle.ByWidthLength(width=getItemAtIndex_19, length=getItemAtIndex_20)

flatten_18 = List.Flatten(list=valueAtKey_36)

# group (continued): REC (사각형) 변경 전
X_7 = Point.X(point=flatten_18)

flatten_19 = List.Flatten(list=valueAtKey_36)

# group (continued): REC (사각형) 변경 전
Y_7 = Point.Y(point=flatten_19)

flatten_20 = List.Flatten(list=valueAtKey_36)

# group (continued): REC (사각형) 변경 전
Z_3 = Point.Z(point=flatten_20)
translate = Geometry.Translate(geometry=byWidthLength, xTranslation=X_7, yTranslation=Y_7, zTranslation=Z_3)
byPatch = Surface.ByPatch(closedCurve=translate)
code_block_98 = CodeBlock(RoomRectangle=translate, RoomRectangleZvalue=Z_3, RoomRectangleSurface=byPatch)
# ---------- code_block_98.designscript (5 lines) ----------
{
"RoomRectangle": _RoomRectangle,
"RoomRectangleZvalue": _RoomRectangleZvalue,
"RoomRectangleSurface": _RoomRectangleSurface
};
# ----------------------------------------
extendsChildDictionaryFromParent_14 = Custom[ExtendsChildDictionaryFromParent](ParentDic=code_block_93, ChildDic=code_block_98)

# group: 부서별 색상 지정
code_block_99 = CodeBlock(InputDic=extendsChildDictionaryFromParent_14.dictionary) { _InputDic; }
code_block_100 = CodeBlock { "Department"; }
valueAtKey_41 = DesignScript.Builtin.Dictionary.ValueAtKey(dictionary=code_block_99, key=code_block_100)
watch_33 = Watch(valueAtKey_41)
uniqueItems_8 = List.UniqueItems(list=watch_33)
code_block_101 = CodeBlock()
# ---------- code_block_101.designscript (6 lines) ----------
color1 = Color.ByARGB(200, 100, 0, 200);
color2 = Color.ByARGB(200, 0, 0, 0);
color3 = Color.ByARGB(200, 200, 0, 0);
color4 = Color.ByARGB(200, 0, 0, 200);
color5 = Color.ByARGB(200, 200, 0, 100);
color6 = Color.ByARGB(200, 0, 200, 0);
# ----------------------------------------
remember_3 = Data.Remember(code_block_101.color1)
remember_4 = Data.Remember(code_block_101.color2)
remember_5 = Data.Remember(code_block_101.color3)
remember_6 = Data.Remember(code_block_101.color4)
remember_7 = Data.Remember(code_block_101.color5)
remember_8 = Data.Remember(code_block_101.color6)
join_3 = List.Join(list0=remember_3, list1=remember_4, list2=remember_5, list3=remember_6, list4=remember_7, list5=remember_8)
byKeysValues_3 = DesignScript.Builtin.Dictionary.ByKeysValues(keys=uniqueItems_8, values=join_3)
code_block_102 = CodeBlock(DepartmentColorDic=byKeysValues_3)
# ---------- code_block_102.designscript (3 lines) ----------
{
"DepartmentColorDic": _DepartmentColorDic
};
# ----------------------------------------
extendsChildDictionaryFromParent_15 = Custom[ExtendsChildDictionaryFromParent](ParentDic=code_block_99, ChildDic=code_block_102)

# group: 사각 공간 색상 지정
code_block_103 = CodeBlock(InputDic=extendsChildDictionaryFromParent_15.dictionary) { _InputDic; }
code_block_104 = CodeBlock { "RoomRectangleSurface"; }
valueAtKey_42 = DesignScript.Builtin.Dictionary.ValueAtKey(dictionary=code_block_103, key=code_block_104)
code_block_105 = CodeBlock { "BoxHeight"; }
valueAtKey_43 = DesignScript.Builtin.Dictionary.ValueAtKey(dictionary=code_block_103, key=code_block_105)
boolean_7 = BoolSelector(false)
thicken = Surface.Thicken(surface=valueAtKey_42, thickness=valueAtKey_43, both_sides=boolean_7)
code_block_106 = CodeBlock { "DepartmentColorDic"; }
valueAtKey_44 = DesignScript.Builtin.Dictionary.ValueAtKey(dictionary=code_block_103, key=code_block_106)
code_block_107 = CodeBlock { "Department"; }
valueAtKey_45 = DesignScript.Builtin.Dictionary.ValueAtKey(dictionary=code_block_103, key=code_block_107)
code_block_108 = CodeBlock { "SpaceIDPerDepartment"; }
valueAtKey_46 = DesignScript.Builtin.Dictionary.ValueAtKey(dictionary=code_block_103, key=code_block_108)
flatten_21 = List.Flatten(list=valueAtKey_46)
getItemAtIndex_21 = List.GetItemAtIndex(list=valueAtKey_45, index=flatten_21)
valueAtKey_47 = DesignScript.Builtin.Dictionary.ValueAtKey(dictionary=valueAtKey_44, key=getItemAtIndex_21)
byGeometryColor = Modifiers.GeometryColor.ByGeometryColor(geometry=thicken, color=valueAtKey_47)
code_block_109 = CodeBlock(RoomSolid=thicken)
# ---------- code_block_109.designscript (3 lines) ----------
{
"RoomSolid": _RoomSolid
};
# ----------------------------------------
extendsChildDictionaryFromParent_16 = Custom[ExtendsChildDictionaryFromParent](ParentDic=code_block_103, ChildDic=code_block_109)

# group: GD Output - difference area to minimum
code_block_110 = CodeBlock(InputDic=extendsChildDictionaryFromParent_16.dictionary) { _InputDic; }
code_block_111 = CodeBlock { "RoomRectangle"; }
valueAtKey_48 = DesignScript.Builtin.Dictionary.ValueAtKey(dictionary=code_block_110, key=code_block_111)
flatten_22 = List.Flatten(list=valueAtKey_48)
code_block_112 = CodeBlock { "RoomRectangleZvalue"; }
valueAtKey_49 = DesignScript.Builtin.Dictionary.ValueAtKey(dictionary=code_block_110, key=code_block_112)
flatten_23 = List.Flatten(list=valueAtKey_49)
uniqueItems_9 = List.UniqueItems(list=flatten_23)
allIndicesOf_7 = List.AllIndicesOf(list=flatten_23, item=uniqueItems_9)
code_block_113 = CodeBlock { "RoomBoundary"; }
valueAtKey_50 = DesignScript.Builtin.Dictionary.ValueAtKey(dictionary=code_block_110, key=code_block_113)
basePlane = PolyCurve.BasePlane(polyCurve=valueAtKey_50)
firstItem_4 = List.FirstItem(list=basePlane)
code_block_114 = CodeBlock { 1; }
code_block_115 = CodeBlock { 10; }
offset = Curve.Offset(curve=valueAtKey_50, distance=code_block_115)

flatten_24 = List.Flatten(list=allIndicesOf_7)

# group (continued): GD Output - difference area to minimum
getItemAtIndex_22 = List.GetItemAtIndex(list=flatten_22, index=flatten_24)
pullOntoPlane = Curve.PullOntoPlane(curve=getItemAtIndex_22, plane=firstItem_4)
byPatch_2 = Surface.ByPatch(closedCurve=pullOntoPlane)
split_2 = Geometry.Split(geometry=byPatch_2, other=valueAtKey_50, lacing=CrossProduct)
flatten_25 = List.Flatten(list=split_2@L2, amt=code_block_114)
flatten_26 = List.Flatten(list=flatten_25)
doesIntersect = Geometry.DoesIntersect(geometry=flatten_26@L2, other=offset@L1)
flatten_27 = List.Flatten(list=doesIntersect)
filterByBoolMask_9 = List.FilterByBoolMask(list=flatten_26, mask=flatten_27)
area = Surface.Area(surface=filterByBoolMask_9.in)
math_sum_outside_area_of = Math.Sum(values=area)  # "Math.Sum@Outside Area of Boundary"; graph output

code_block_116 = CodeBlock { 1000; }
byCenterPointRadius = Circle.ByCenterPointRadius(centerPoint=watch_16, radius=code_block_116)
X_8 = Point.X(point=watch_17)
Y_8 = Point.Y(point=watch_17)
