# Dynamo graph 0803 space planning test 005CN_mk.dyn (Dynamo 2.10.1.3976)
# packages: GenerativeDesign.Revit 1.7.3.0, GenerativeDesign 1.7.3.0, Clockwork for Dynamo 2.x 2.3.0

# group: User Inputs for GDIR
# note: Custom Package: GenerativeDesign v.2021.5.5
select_room_to_load_program_into = DSModelRoomSelection()  # 1 picked in the model; graph input
# note: Retrieve the room's finish boundary.
# Note: The first sublist is the outermost boundary of the room.
finishBoundary = Room.FinishBoundary(room=select_room_to_load_program_into)
remember = Data.Remember(finishBoundary)

# group: Extract room boundary for DynaSpace and cache it in the graph
firstItem = List.FirstItem(list=remember@L3)
startPoint = Curve.StartPoint(curve=firstItem)
flatten = List.Flatten(list=startPoint)
byJoinedCurves = PolyCurve.ByJoinedCurves(curves=firstItem)
code_block = CodeBlock(RoomBoundary=byJoinedCurves)
# ---------- code_block.designscript (3 lines) ----------
{
"RoomBoundary": _RoomBoundary
};
# ----------------------------------------

# group: Excel Data import (package 정리 전)
file_path = Filename(".\space planning test 0802mk 001.xlsx")
file_from_path = FileObject(path=file_path)
string_from_object = FromObject(object=file_from_path)
code_block_2 = CodeBlock { "Sheet1"; "SampleBuildingProgram-Clinic"; false; }
python_script_import_excel_by = Python(IN[0]=string_from_object, IN[1]=code_block_2.out0)  # "Python Script@Import Excel(By OpenpyXl)"; CPython3
# ---------- python_script_import_excel_by.python (50 lines) ----------
# Load the Python Standard and DesignScript Libraries
import sys
import os
#sys.path.append(r'C:\Users\HEC\AppData\Local\Programs\Python\Python39\Lib\site-packages')
#sys.path.append(r'C:\Users\pjmk0\AppData\Local\Programs\Python\Python39\Lib\site-packages')
sys.path.append(os.getenv('LOCALAPPDATA').replace('\\','\\\\') + r'\Programs\Python\Python39\Lib\site-packages')
import clr
clr.AddReference('ProtoGeometry')
from Autodesk.DesignScript.Geometry import *
from collections import Iterable

def iterable(obj):
    return isinstance(obj, Iterable)


# The inputs to this node will be stored as a list in the IN variables.
dataEnteringNode = IN
PathIn = IN[0]
SheetNameIn = IN[1]

# Place your code below this line
import datetime
import openpyxl

path = (PathIn)
#path = (r'C:\Users\pjmk0\Downloads\MK\mQ\BIM_물량집계 자동화 산출기준표_rC(20210607)_mk_de.xlsx')

wb_obj = openpyxl.load_workbook(path, data_only=True)
sheet_obj = wb_obj.get_sheet_by_name(SheetNameIn)

m_row = sheet_obj.max_row
m_col = sheet_obj.max_column

listOut = []



for i in range(1, m_row +1):
    listTemp = []
    for j in range(1, m_col + 1):
        cell_obj = sheet_obj.cell(row=i, column=j)
        listTemp.append(cell_obj.value)
        if len(listTemp) == m_col:
            listOut.append(listTemp)
        


# Assign your output to the OUT variable.
OUT = listOut
#OUT = os.getenv('APPDATA')
# ----------------------------------------
excel_data_정리_전 = Watch(python_script_import_excel_by)

remember_2 = Data.Remember(excel_data_정리_전)
code_block_3 = CodeBlock { 11; }

# group: 고정부 Seed
seed_고정부_코어 = DoubleSlider(660, range=0..999 step 1)  # graph input

# group: 변동부 Seed
seed_변형부_공간 = DoubleSlider(263, range=0..999 step 1)  # graph input

# group: Lev 높이
number = DoubleInput(2000)

code_block_4 = CodeBlock(FixedPartSeed=seed_고정부_코어, NonFixedPartSeed=seed_변형부_공간, BoxHeight=number)
# ---------- code_block_4.designscript (5 lines) ----------
{
"FixedPartSeed": _FixedPartSeed,
"NonFixedPartSeed": _NonFixedPartSeed,
"BoxHeight": _BoxHeight
};
# ----------------------------------------
extendsChildDictionaryFromParent = Custom[ExtendsChildDictionaryFromParent](ParentDic=code_block, ChildDic=code_block_4)  # Extends Child Dictionary From Parent

# group: Excel List 분할
excel_data_정리_전_2 = Watch(remember_2)
transpose = List.Transpose(lists=excel_data_정리_전_2)
code_block_5 = CodeBlock { 1; }
# note: List Name 정리
dropItems = List.DropItems(list=transpose@L2, amount=code_block_5)
watch = Watch(dropItems)
code_block_6 = CodeBlock { 0; }
getItemAtIndex = List.GetItemAtIndex(list=watch, index=code_block_6)
space_id = Watch(getItemAtIndex)
code_block_7 = CodeBlock { 1; }
getItemAtIndex_2 = List.GetItemAtIndex(list=watch, index=code_block_7)
space_name = Watch(getItemAtIndex_2)
code_block_8 = CodeBlock { 10; }
getItemAtIndex_3 = List.GetItemAtIndex(list=watch, index=code_block_8)
adjacent_spaces = Watch(getItemAtIndex_3)
code_block_9 = CodeBlock { 3; }
getItemAtIndex_4 = List.GetItemAtIndex(list=watch, index=code_block_9)
department_id = Watch(getItemAtIndex_4)
code_block_10 = CodeBlock { 2; }
getItemAtIndex_5 = List.GetItemAtIndex(list=watch, index=code_block_10)
DEPARTMENT = Watch(getItemAtIndex_5)
code_block_11 = CodeBlock { 5; }
getItemAtIndex_6 = List.GetItemAtIndex(list=watch, index=code_block_11)
WIDTH = Watch(getItemAtIndex_6)
code_block_12 = CodeBlock { 6; }
getItemAtIndex_7 = List.GetItemAtIndex(list=watch, index=code_block_12)
length = Watch(getItemAtIndex_7)
code_block_13 = CodeBlock { 7; }
getItemAtIndex_8 = List.GetItemAtIndex(list=watch, index=code_block_13)
height = Watch(getItemAtIndex_8)
code_block_14 = CodeBlock { 8; }
getItemAtIndex_9 = List.GetItemAtIndex(list=watch, index=code_block_14)
AREA = Watch(getItemAtIndex_9)

getItemAtIndex_10 = List.GetItemAtIndex(list=watch, index=code_block_3)

# group (continued): Excel List 분할
lev = Watch(getItemAtIndex_10)
code_block_15 = CodeBlock(ExcelDataWithNoHead=watch, SpaceID=space_id, SpaceName=space_name, AdjacentSpaces=adjacent_spaces, DepartmentID=department_id, Department=DEPARTMENT, Level=lev, Width=WIDTH, Length=length, Height=height, Area=AREA)
# ---------- code_block_15.designscript (13 lines) ----------
{
"ExcelDataWithNoHead": _ExcelDataWithNoHead,
"SpaceID": _SpaceID,
"SpaceName": _SpaceName,
"AdjacentSpaces": _AdjacentSpaces,
"DepartmentID": _DepartmentID,
"Department": _Department,
"Level": _Level,
"Width": _Width,
"Length": _Length,
"Height": _Height,
"Area": _Area
};
# ----------------------------------------
extendsChildDictionaryFromParent_2 = Custom[ExtendsChildDictionaryFromParent](ParentDic=code_block_15, ChildDic=extendsChildDictionaryFromParent.dictionary)

# group: Level에 따라 Z 값 Dictionary 추출
code_block_16 = CodeBlock(InputDic=extendsChildDictionaryFromParent_2.dictionary) { _InputDic; }
code_block_17 = CodeBlock { "Level"; }
valueAtKey = DesignScript.Builtin.Dictionary.ValueAtKey(dictionary=code_block_16, key=code_block_17)
lev_2 = Watch(valueAtKey)
uniqueItems = List.UniqueItems(list=lev_2)
code_block_18 = CodeBlock { -2000..4000..2000; }
byKeysValues = DesignScript.Builtin.Dictionary.ByKeysValues(keys=uniqueItems, values=code_block_18)
watch_2 = Watch(byKeysValues)
valueAtKey_2 = DesignScript.Builtin.Dictionary.ValueAtKey(dictionary=watch_2, key=lev_2)
z_값_lev_에서_추출 = Watch(valueAtKey_2)
code_block_19 = CodeBlock(ZvalueFromLevel=z_값_lev_에서_추출)
# ---------- code_block_19.designscript (3 lines) ----------
{
"ZvalueFromLevel": _ZvalueFromLevel
};
# ----------------------------------------
extendsChildDictionaryFromParent_3 = Custom[ExtendsChildDictionaryFromParent](ParentDic=code_block_16, ChildDic=code_block_19)

# group: 룸 BoundingBox 포인트 추출
code_block_20 = CodeBlock(InputDic=extendsChildDictionaryFromParent_3.dictionary) { _InputDic; }
code_block_21 = CodeBlock { "RoomBoundary"; }
valueAtKey_3 = DesignScript.Builtin.Dictionary.ValueAtKey(dictionary=code_block_20, key=code_block_21)
byGeometry = BoundingBox.ByGeometry(geom=valueAtKey_3)
minPoint = BoundingBox.MinPoint(boundingBox=byGeometry)
X = Point.X(point=minPoint)
maxPoint = BoundingBox.MaxPoint(boundingBox=byGeometry)
X_2 = Point.X(point=maxPoint)
code_block_22 = CodeBlock { 500; }
code_block_23 = CodeBlock(a=X, b=X_2, x=code_block_22) { a..b..x; }
Y = Point.Y(point=minPoint)
Y_2 = Point.Y(point=maxPoint)
code_block_24 = CodeBlock { 500; }
code_block_25 = CodeBlock(a=Y, b=Y_2, x=code_block_24) { a..b..x; }
byCoordinates = Point.ByCoordinates(x=code_block_23, y=code_block_25, lacing=CrossProduct)
flatten_2 = List.Flatten(list=byCoordinates)
code_block_26 = CodeBlock(GridPointOfBoundingBox=flatten_2)
# ---------- code_block_26.designscript (3 lines) ----------
{
"GridPointOfBoundingBox": _GridPointOfBoundingBox
};
# ----------------------------------------
extendsChildDictionaryFromParent_4 = Custom[ExtendsChildDictionaryFromParent](ParentDic=code_block_20, ChildDic=code_block_26)

# group: 고정부/변동부 구별
code_block_27 = CodeBlock(InputDic=extendsChildDictionaryFromParent_4.dictionary) { _InputDic; }
code_block_28 = CodeBlock { "DepartmentID"; }
valueAtKey_4 = DesignScript.Builtin.Dictionary.ValueAtKey(dictionary=code_block_27, key=code_block_28)
# note: 3 = Path V = 계단
department_id_2 = Watch(valueAtKey_4)
code_block_29 = CodeBlock { [3,5,6]; }
eq = department_id_2 == code_block_29@L1
boolean = BoolSelector(true)
allIndicesOf = List.AllIndicesOf(list=eq@L2, item=boolean)
boolean_2 = BoolSelector(false)
allIndicesOf_2 = List.AllIndicesOf(list=eq@L2, item=boolean_2)
flatten_3 = List.Flatten(list=allIndicesOf_2)
uniqueItems_2 = List.UniqueItems(list=flatten_3)
flatten_4 = List.Flatten(list=allIndicesOf)
setDifference = List.SetDifference(list1=uniqueItems_2, list2=flatten_4)
code_block_30 = CodeBlock(FixedPartIndex=allIndicesOf, NonFixedPartIndex=setDifference)
# ---------- code_block_30.designscript (4 lines) ----------
{
"FixedPartIndex": _FixedPartIndex,
"NonFixedPartIndex": _NonFixedPartIndex
};
# ----------------------------------------
extendsChildDictionaryFromParent_5 = Custom[ExtendsChildDictionaryFromParent](ParentDic=code_block_27, ChildDic=code_block_30)

# group: 층별 고정부 Point Index 추출
code_block_31 = CodeBlock(InputDic=extendsChildDictionaryFromParent_5.dictionary) { _InputDic; }
ofRepeatedItem = List.OfRepeatedItem()  # unwired: item, amount
code_block_32 = CodeBlock { "Level"; }
valueAtKey_5 = DesignScript.Builtin.Dictionary.ValueAtKey(dictionary=code_block_31, key=code_block_32)
code_block_33 = CodeBlock { "FixedPartIndex"; }
valueAtKey_6 = DesignScript.Builtin.Dictionary.ValueAtKey(dictionary=code_block_31, key=code_block_33)
getItemAtIndex_11 = List.GetItemAtIndex(list=valueAtKey_5, index=valueAtKey_6)
uniqueItems_3 = List.UniqueItems(list=getItemAtIndex_11@L2)
count = List.Count(list=uniqueItems_3@L3)
code_block_34 = CodeBlock { 0; }
code_block_35 = CodeBlock { "GridPointOfBoundingBox"; }
valueAtKey_7 = DesignScript.Builtin.Dictionary.ValueAtKey(dictionary=code_block_31, key=code_block_35)
count_2 = List.Count(list=valueAtKey_7)
watch_3 = Watch(count_2)
code_block_36 = CodeBlock { "FixedPartSeed"; }
valueAtKey_8 = DesignScript.Builtin.Dictionary.ValueAtKey(dictionary=code_block_31, key=code_block_36)
randomList = Math.RandomList(amount=count, value1=code_block_34, value2=watch_3, seed=valueAtKey_8)
flatten_5 = List.Flatten(list=randomList)
count_3 = List.Count(list=uniqueItems_3@L2)
laceShortest = List.LaceShortest(combineFunction=ofRepeatedItem, list0=flatten_5, list1=count_3)
watch_4 = Watch(laceShortest)
round = Math.Round(number=watch_4)
code_block_37 = CodeBlock(FixedPartPointIndex=round)
# ---------- code_block_37.designscript (3 lines) ----------
{
"FixedPartPointIndex": _FixedPartPointIndex
};
# ----------------------------------------
extendsChildDictionaryFromParent_6 = Custom[ExtendsChildDictionaryFromParent](ParentDic=code_block_31, ChildDic=code_block_37)

# group: 층별 변동부 Point Index 추출
code_block_38 = CodeBlock(InputDic=extendsChildDictionaryFromParent_6.dictionary) { _InputDic; }
code_block_39 = CodeBlock { "Level"; }
valueAtKey_9 = DesignScript.Builtin.Dictionary.ValueAtKey(dictionary=code_block_38, key=code_block_39)
code_block_40 = CodeBlock { "NonFixedPartIndex"; }
valueAtKey_10 = DesignScript.Builtin.Dictionary.ValueAtKey(dictionary=code_block_38, key=code_block_40)
getItemAtIndex_12 = List.GetItemAtIndex(list=valueAtKey_9, index=valueAtKey_10)
uniqueItems_4 = List.UniqueItems(list=getItemAtIndex_12)
eq_2 = uniqueItems_4 == getItemAtIndex_12  # lacing=CrossProduct
countTrue = List.CountTrue(list=eq_2@L2)
sum = Math.Sum(values=countTrue)
code_block_41 = CodeBlock { 0; }
code_block_42 = CodeBlock { "GridPointOfBoundingBox"; }
valueAtKey_11 = DesignScript.Builtin.Dictionary.ValueAtKey(dictionary=code_block_38, key=code_block_42)
count_4 = List.Count(list=valueAtKey_11)
watch_5 = Watch(count_4)
code_block_43 = CodeBlock { "NonFixedPartSeed"; }
valueAtKey_12 = DesignScript.Builtin.Dictionary.ValueAtKey(dictionary=code_block_38, key=code_block_43)
randomList_2 = Math.RandomList(amount=sum, value1=code_block_41, value2=watch_5, seed=valueAtKey_12)
watch_6 = Watch(randomList_2)
round_2 = Math.Round(number=watch_6)
code_block_44 = CodeBlock(NonFixedPartPointIndex=round_2)
# ---------- code_block_44.designscript (3 lines) ----------
{
"NonFixedPartPointIndex": _NonFixedPartPointIndex
};
# ----------------------------------------
extendsChildDictionaryFromParent_7 = Custom[ExtendsChildDictionaryFromParent](ParentDic=code_block_38, ChildDic=code_block_44)

# group: Total Room Point Index List 추출
code_block_45 = CodeBlock(InputDic=extendsChildDictionaryFromParent_7.dictionary) { _InputDic; }
code_block_46 = CodeBlock { "FixedPartPointIndex"; }
valueAtKey_13 = DesignScript.Builtin.Dictionary.ValueAtKey(dictionary=code_block_45, key=code_block_46)
firstItem_2 = List.FirstItem(list=valueAtKey_13@L2)
code_block_47 = CodeBlock { "DepartmentID"; }
valueAtKey_14 = DesignScript.Builtin.Dictionary.ValueAtKey(dictionary=code_block_45, key=code_block_47)
count_5 = List.Count(list=valueAtKey_14)
code_block_48 = CodeBlock(a=count_5) { a-1; }
code_block_49 = CodeBlock(a=code_block_48) { 0..a..1; }
code_block_50 = CodeBlock { "FixedPartIndex"; }
valueAtKey_15 = DesignScript.Builtin.Dictionary.ValueAtKey(dictionary=code_block_45, key=code_block_50)
replaceItemAtIndex = Custom[List.ReplaceItemAtIndex+](seq=code_block_49, indices=valueAtKey_15, replacement=valueAtKey_13)  # package Clockwork for Dynamo 2.x; Replaces the item at a given index of a list by another item. Unlike the OOTB node, it can replace items at multiple indeces.
code_block_51 = CodeBlock { "NonFixedPartIndex"; }
valueAtKey_16 = DesignScript.Builtin.Dictionary.ValueAtKey(dictionary=code_block_45, key=code_block_51)
code_block_52 = CodeBlock { "NonFixedPartPointIndex"; }
valueAtKey_17 = DesignScript.Builtin.Dictionary.ValueAtKey(dictionary=code_block_45, key=code_block_52)
replaceItemAtIndex_2 = Custom[List.ReplaceItemAtIndex+](seq=replaceItemAtIndex, indices=valueAtKey_16, replacement=valueAtKey_17)
point_index_list_추출 = Watch(replaceItemAtIndex_2)
code_block_53 = CodeBlock(TotalRoomPointIndexList=point_index_list_추출)
# ---------- code_block_53.designscript (3 lines) ----------
{
"TotalRoomPointIndexList": _TotalRoomPointIndexList
};
# ----------------------------------------
extendsChildDictionaryFromParent_8 = Custom[ExtendsChildDictionaryFromParent](ParentDic=code_block_45, ChildDic=code_block_53)

# group: Center Points
code_block_54 = CodeBlock(InputDic=extendsChildDictionaryFromParent_8.dictionary) { _InputDic; }
code_block_55 = CodeBlock { "GridPointOfBoundingBox"; }
valueAtKey_18 = DesignScript.Builtin.Dictionary.ValueAtKey(dictionary=code_block_54, key=code_block_55)
code_block_56 = CodeBlock { "TotalRoomPointIndexList"; }
valueAtKey_19 = DesignScript.Builtin.Dictionary.ValueAtKey(dictionary=code_block_54, key=code_block_56)
flatten_6 = List.Flatten(list=valueAtKey_19)
getItemAtIndex_13 = List.GetItemAtIndex(list=valueAtKey_18, index=flatten_6)
X_3 = Point.X(point=getItemAtIndex_13)
Y_3 = Point.Y(point=getItemAtIndex_13)
code_block_57 = CodeBlock { "ZvalueFromLevel"; }
valueAtKey_20 = DesignScript.Builtin.Dictionary.ValueAtKey(dictionary=code_block_54, key=code_block_57)
byCoordinates_2 = Point.ByCoordinates(x=X_3, y=Y_3, z=valueAtKey_20, lacing=Shortest)
code_block_58 = CodeBlock(TotalRoomCenterPoint=byCoordinates_2)
# ---------- code_block_58.designscript (3 lines) ----------
{
"TotalRoomCenterPoint": _TotalRoomCenterPoint
};
# ----------------------------------------
extendsChildDictionaryFromParent_9 = Custom[ExtendsChildDictionaryFromParent](ParentDic=code_block_54, ChildDic=code_block_58)

# group: Department 별 Boolean Index
code_block_59 = CodeBlock(InputDic=extendsChildDictionaryFromParent_9.dictionary) { _InputDic; }
code_block_60 = CodeBlock { "ExcelDataWithNoHead"; }
valueAtKey_21 = DesignScript.Builtin.Dictionary.ValueAtKey(dictionary=code_block_59, key=code_block_60)
code_block_61 = CodeBlock { 2; }
getItemAtIndex_14 = List.GetItemAtIndex(list=valueAtKey_21, index=code_block_61)
watch_7 = Watch(getItemAtIndex_14)
uniqueItems_5 = List.UniqueItems(list=watch_7)
eq_3 = uniqueItems_5 == watch_7  # lacing=CrossProduct
code_block_62 = CodeBlock(BlnIndexPerDepartment=eq_3)
# ---------- code_block_62.designscript (3 lines) ----------
{
"BlnIndexPerDepartment": _BlnIndexPerDepartment
};
# ----------------------------------------
extendsChildDictionaryFromParent_10 = Custom[ExtendsChildDictionaryFromParent](ParentDic=code_block_59, ChildDic=code_block_62)

# group: Department로 List 분류-1
code_block_63 = CodeBlock(InputDic=extendsChildDictionaryFromParent_10.dictionary) { _InputDic; }
code_block_64 = CodeBlock { "SpaceID"; }
valueAtKey_22 = DesignScript.Builtin.Dictionary.ValueAtKey(dictionary=code_block_63, key=code_block_64)
space_id_2 = Watch(valueAtKey_22)
code_block_65 = CodeBlock { "BlnIndexPerDepartment"; }
valueAtKey_23 = DesignScript.Builtin.Dictionary.ValueAtKey(dictionary=code_block_63, key=code_block_65)
filterByBoolMask = List.FilterByBoolMask(list=space_id_2, mask=valueAtKey_23@L2)
watch_8 = Watch(filterByBoolMask.in)
code_block_66 = CodeBlock { "TotalRoomCenterPoint"; }
valueAtKey_24 = DesignScript.Builtin.Dictionary.ValueAtKey(dictionary=code_block_63, key=code_block_66)
filterByBoolMask_2 = List.FilterByBoolMask(list=valueAtKey_24, mask=valueAtKey_23@L2)
watch_9 = Watch(filterByBoolMask_2.in)
code_block_67 = CodeBlock { "Area"; }
valueAtKey_25 = DesignScript.Builtin.Dictionary.ValueAtKey(dictionary=code_block_63, key=code_block_67)
AREA_2 = Watch(valueAtKey_25)
code_block_68 = CodeBlock(a=AREA_2) { a/2; }
filterByBoolMask_3 = List.FilterByBoolMask(list=code_block_68, mask=valueAtKey_23@L2)
watch_10 = Watch(filterByBoolMask_3.in)
code_block_69 = CodeBlock(SpaceIDPerDepartment=watch_8, RoomCenterPointPerDe=watch_9, AreaPerDepartment=watch_10)
# ---------- code_block_69.designscript (5 lines) ----------
{
"SpaceIDPerDepartment": _SpaceIDPerDepartment,
"RoomCenterPointPerDepartment": _RoomCenterPointPerDepartment,
"AreaPerDepartment": _AreaPerDepartment
};
# ----------------------------------------
extendsChildDictionaryFromParent_11 = Custom[ExtendsChildDictionaryFromParent](ParentDic=code_block_63, ChildDic=code_block_69)

code_block_70 = CodeBlock(InputDic=extendsChildDictionaryFromParent_9.dictionary) { _InputDic; }
code_block_71 = CodeBlock { "SpaceID"; }
valueAtKey_26 = DesignScript.Builtin.Dictionary.ValueAtKey(dictionary=code_block_70, key=code_block_71)
code_block_72 = CodeBlock(BoxSpaceID=valueAtKey_26)  # unwired: BoxSpaceName, BoxDepartment, BoxWidth, BoxLength, BoxHeigth, BoxAdjacentSpaces, BoxLevel, BoxGeometry, BoxCenterPoint
# ---------- code_block_72.designscript (13 lines) ----------
///매스 클래스
{
"BoxSpaceID": _BoxSpaceID,
"BoxSpaceName": _BoxSpaceName,
"BoxDepartment": _BoxDepartment,
"BoxWidth": _BoxWidth,
"BoxLength": _BoxLength,
"BoxHeigth": _BoxHeigth,
"BoxAdjacentSpaces": _BoxAdjacentSpaces,
"BoxLevel": _BoxLevel,
"BoxGeometry": _BoxGeometry,
"BoxCenterPoint": _BoxCenterPoint
};
# ----------------------------------------
watch_11 = Watch(extendsChildDictionaryFromParent_9.key)
string_from_object_2 = FromObject()  # frozen; unwired: object
dictionary_bykeysvalues = DesignScript.Builtin.Dictionary.ByKeysValues(keys=string_from_object_2)  # "Dictionary.ByKeysValues@SpaceName"; unwired: values
dictionary_bykeysvalues_2 = DesignScript.Builtin.Dictionary.ByKeysValues(keys=string_from_object_2)  # "Dictionary.ByKeysValues@AdjacentSpaces"; unwired: values
dictionary_bykeysvalues_3 = DesignScript.Builtin.Dictionary.ByKeysValues(keys=string_from_object_2)  # "Dictionary.ByKeysValues@DepartmentID"; unwired: values
dictionary_bykeysvalues_4 = DesignScript.Builtin.Dictionary.ByKeysValues(keys=string_from_object_2)  # "Dictionary.ByKeysValues@Department"; unwired: values
dictionary_bykeysvalues_level = DesignScript.Builtin.Dictionary.ByKeysValues(keys=string_from_object_2)  # unwired: values
dictionary_bykeysvalues_width = DesignScript.Builtin.Dictionary.ByKeysValues(keys=string_from_object_2)  # unwired: values
dictionary_bykeysvalues_length = DesignScript.Builtin.Dictionary.ByKeysValues(keys=string_from_object_2)  # unwired: values
dictionary_bykeysvalues_height = DesignScript.Builtin.Dictionary.ByKeysValues(keys=string_from_object_2)  # unwired: values
dictionary_bykeysvalues_area = DesignScript.Builtin.Dictionary.ByKeysValues(keys=string_from_object_2)  # unwired: values
code_block_73 = CodeBlock(InputDic=code_block_15) { _InputDic; }
code_block_74 = CodeBlock { "SpaceID"; }
valueAtKey_27 = DesignScript.Builtin.Dictionary.ValueAtKey(dictionary=code_block_73, key=code_block_74)
code_block_75 = CodeBlock { "SpaceName"; }
valueAtKey_28 = DesignScript.Builtin.Dictionary.ValueAtKey(dictionary=code_block_73, key=code_block_75)
code_block_76 = CodeBlock { "AdjacentSpaces"; }
valueAtKey_29 = DesignScript.Builtin.Dictionary.ValueAtKey(dictionary=code_block_73, key=code_block_76)
code_block_77 = CodeBlock { "DepartmentID"; }
valueAtKey_30 = DesignScript.Builtin.Dictionary.ValueAtKey(dictionary=code_block_73, key=code_block_77)
code_block_78 = CodeBlock { "Department"; }
valueAtKey_31 = DesignScript.Builtin.Dictionary.ValueAtKey(dictionary=code_block_73, key=code_block_78)
code_block_79 = CodeBlock { "Level"; }
valueAtKey_32 = DesignScript.Builtin.Dictionary.ValueAtKey(dictionary=code_block_73, key=code_block_79)
code_block_80 = CodeBlock { "Width"; }
valueAtKey_33 = DesignScript.Builtin.Dictionary.ValueAtKey(dictionary=code_block_73, key=code_block_80)
code_block_81 = CodeBlock { "Length"; }
valueAtKey_34 = DesignScript.Builtin.Dictionary.ValueAtKey(dictionary=code_block_73, key=code_block_81)
code_block_82 = CodeBlock { "Height"; }
valueAtKey_35 = DesignScript.Builtin.Dictionary.ValueAtKey(dictionary=code_block_73, key=code_block_82)
code_block_83 = CodeBlock { "Area"; }
valueAtKey_36 = DesignScript.Builtin.Dictionary.ValueAtKey(dictionary=code_block_73, key=code_block_83)
byLengths = Cuboid.ByLengths(width=valueAtKey_33, length=valueAtKey_34, height=valueAtKey_35)
centroid = Solid.Centroid(solid=byLengths)
code_block_84 = CodeBlock(BoxSpaceID=valueAtKey_27, BoxSpaceName=valueAtKey_28, BoxAdjacentSpaces=valueAtKey_29, BoxDepartmentID=valueAtKey_30, BoxDepartment=valueAtKey_31, BoxLevel=valueAtKey_32, BoxWidth=valueAtKey_33, BoxLength=valueAtKey_34, BoxHeight=valueAtKey_35, BoxArea=valueAtKey_36, BoxGeometry=byLengths, BoxCenterPoint=centroid)
# ---------- code_block_84.designscript (15 lines) ----------
///매스 클래스
{
"BoxSpaceID": _BoxSpaceID,
"BoxSpaceName": _BoxSpaceName,
"BoxAdjacentSpaces": _BoxAdjacentSpaces,
"BoxDepartmentID": _BoxDepartmentID,
"BoxDepartment": _BoxDepartment,
"BoxLevel": _BoxLevel,
"BoxWidth": _BoxWidth,
"BoxLength": _BoxLength,
"BoxHeight": _BoxHeight,
"BoxArea": _BoxArea,
"BoxGeometry": _BoxGeometry,
"BoxCenterPoint": _BoxCenterPoint
};
# ----------------------------------------
code_block_85 = CodeBlock(InputDic=code_block_84) { _InputDic; }
code_block_86 = CodeBlock()  # unwired: PathvBlnIndex
# ---------- code_block_86.designscript (3 lines) ----------
{
"PathvBlnIndex":_PathvBlnIndex
};
# ----------------------------------------
extendsChildDictionaryFromParent_12 = Custom[ExtendsChildDictionaryFromParent](ParentDic=code_block_85, ChildDic=code_block_86)
components = DesignScript.Builtin.Dictionary.Components(dictionary=code_block_85)
transpose_2 = List.Transpose(lists=components.values)
string_from_object_3 = FromObject(object=transpose_2)
code_block_87 = CodeBlock { "PATH"; }
contains = String.Contains(str=string_from_object_3, searchFor=code_block_87)
anyTrue = List.AnyTrue(list=contains@L2)
filterByBoolMask_4 = List.FilterByBoolMask(list=transpose_2, mask=anyTrue)
watch_12 = Watch(filterByBoolMask_4.in)
watch_13 = Watch(filterByBoolMask_4.out)
transpose_3 = List.Transpose(lists=filterByBoolMask_4.in)
byKeysValues_2 = DesignScript.Builtin.Dictionary.ByKeysValues(keys=components.keys, values=transpose_3)
