# Dynamo graph 0805 space planning test 006CN_mk.dyn (Dynamo 2.10.1.3976)
# packages: GenerativeDesign.Revit 1.7.3.0, GenerativeDesign 1.7.3.0, Clockwork for Dynamo 2.x 2.3.0

# group: User Inputs for GDIR
# note: Custom Package: GenerativeDesign v.2021.5.5
select_room_to_load_program_into = DSModelRoomSelection()  # 1 picked in the model; graph input
# note: Retrieve the room's finish boundary.
# Note: The first sublist is the outermost boundary of the room.
finishBoundary = Room.FinishBoundary(room=select_room_to_load_program_into)
remember = Data.Remember(finishBoundary)

# group: Extract room boundary for DynaSpace and cache it in the graph
firstItem = List.FirstItem(list=remember@L3)
startPoint = Curve.StartPoint(curve=firstItem)
flatten = List.Flatten(list=startPoint)
byJoinedCurves = PolyCurve.ByJoinedCurves(curves=firstItem)
code_block = CodeBlock(RoomBoundary=byJoinedCurves)
# ---------- code_block.designscript (3 lines) ----------
{
"RoomBoundary": _RoomBoundary
};
# ----------------------------------------

# group: Lev 높이
number = DoubleInput(2000)

# group: Excel Data import (package 정리 전)
file_path = Filename(".\space planning test 0802mk 001.xlsx")
file_from_path = FileObject(path=file_path)
string_from_object = FromObject(object=file_from_path)
code_block_2 = CodeBlock { "Sheet1"; "SampleBuildingProgram-Clinic"; false; }
python_script_import_excel_by = Python(IN[0]=string_from_object, IN[1]=code_block_2.out0)  # "Python Script@Import Excel(By OpenpyXl)"; CPython3
# ---------- python_script_import_excel_by.python (50 lines) ----------
# Load the Python Standard and DesignScript Libraries
import sys
import os
#sys.path.append(r'C:\Users\HEC\AppData\Local\Programs\Python\Python39\Lib\site-packages')
#sys.path.append(r'C:\Users\pjmk0\AppData\Local\Programs\Python\Python39\Lib\site-packages')
sys.path.append(os.getenv('LOCALAPPDATA').replace('\\','\\\\') + r'\Programs\Python\Python39\Lib\site-packages')
import clr
clr.AddReference('ProtoGeometry')
from Autodesk.DesignScript.Geometry import *
from collections import Iterable

def iterable(obj):
    return isinstance(obj, Iterable)


# The inputs to this node will be stored as a list in the IN variables.
dataEnteringNode = IN
PathIn = IN[0]
SheetNameIn = IN[1]

# Place your code below this line
import datetime
import openpyxl

path = (PathIn)
#path = (r'C:\Users\pjmk0\Downloads\MK\mQ\BIM_물량집계 자동화 산출기준표_rC(20210607)_mk_de.xlsx')

wb_obj = openpyxl.load_workbook(path, data_only=True)
sheet_obj = wb_obj.get_sheet_by_name(SheetNameIn)

m_row = sheet_obj.max_row
m_col = sheet_obj.max_column

listOut = []



for i in range(1, m_row +1):
    listTemp = []
    for j in range(1, m_col + 1):
        cell_obj = sheet_obj.cell(row=i, column=j)
        listTemp.append(cell_obj.value)
        if len(listTemp) == m_col:
            listOut.append(listTemp)
        


# Assign your output to the OUT variable.
OUT = listOut
#OUT = os.getenv('APPDATA')
# ----------------------------------------
excel_data_정리_전 = Watch(python_script_import_excel_by)

remember_2 = Data.Remember(excel_data_정리_전)
code_block_3 = CodeBlock { 11; }

# group: 고정부 Seed
seed_고정부_코어 = DoubleSlider(736, range=0..999 step 1)  # graph input

# group: 변동부 Seed
seed_변형부_공간 = DoubleSlider(263, range=0..999 step 1)  # graph input

# group: 회전 Seed
seed_회전용 = DoubleSlider(139, range=0..999 step 1)  # graph input

code_block_4 = CodeBlock(FixedPartSeed=seed_고정부_코어, NonFixedPartSeed=seed_변형부_공간, RotatingSeed=seed_회전용)
# ---------- code_block_4.designscript (6 lines) ----------
{
"FixedPartSeed": _FixedPartSeed,
"NonFixedPartSeed": _NonFixedPartSeed,
"RotatingSeed": _RotatingSeed
//"BoxHeight": _BoxHeight
};
# ----------------------------------------
extendsChildDictionaryFromParent = Custom[ExtendsChildDictionaryFromParent](ParentDic=code_block, ChildDic=code_block_4)  # Extends Child Dictionary From Parent

# group: Excel List 분할
excel_data_정리_전_2 = Watch(remember_2)
transpose = List.Transpose(lists=excel_data_정리_전_2)
code_block_5 = CodeBlock { 1; }
# note: List Name 정리
dropItems = List.DropItems(list=transpose@L2, amount=code_block_5)
watch = Watch(dropItems)
code_block_6 = CodeBlock { 0; }
getItemAtIndex = List.GetItemAtIndex(list=watch, index=code_block_6)
space_id = Watch(getItemAtIndex)
code_block_7 = CodeBlock { 1; }
getItemAtIndex_2 = List.GetItemAtIndex(list=watch, index=code_block_7)
space_name = Watch(getItemAtIndex_2)
code_block_8 = CodeBlock { 10; }
getItemAtIndex_3 = List.GetItemAtIndex(list=watch, index=code_block_8)
adjacent_spaces = Watch(getItemAtIndex_3)
code_block_9 = CodeBlock { 3; }
getItemAtIndex_4 = List.GetItemAtIndex(list=watch, index=code_block_9)
department_id = Watch(getItemAtIndex_4)
code_block_10 = CodeBlock { 2; }
getItemAtIndex_5 = List.GetItemAtIndex(list=watch, index=code_block_10)
DEPARTMENT = Watch(getItemAtIndex_5)
code_block_11 = CodeBlock { 5; }
getItemAtIndex_6 = List.GetItemAtIndex(list=watch, index=code_block_11)
WIDTH = Watch(getItemAtIndex_6)
code_block_12 = CodeBlock { 6; }
getItemAtIndex_7 = List.GetItemAtIndex(list=watch, index=code_block_12)
length = Watch(getItemAtIndex_7)
code_block_13 = CodeBlock { 7; }
getItemAtIndex_8 = List.GetItemAtIndex(list=watch, index=code_block_13)
height = Watch(getItemAtIndex_8)
code_block_14 = CodeBlock { 8; }
getItemAtIndex_9 = List.GetItemAtIndex(list=watch, index=code_block_14)
AREA = Watch(getItemAtIndex_9)

getItemAtIndex_10 = List.GetItemAtIndex(list=watch, index=code_block_3)

# group (continued): Excel List 분할
lev = Watch(getItemAtIndex_10)
code_block_15 = CodeBlock(ExcelDataWithNoHead=watch, SpaceID=space_id, SpaceName=space_name, AdjacentSpaces=adjacent_spaces, DepartmentID=department_id, Department=DEPARTMENT, Level=lev, Width=WIDTH, Length=length, Height=height, Area=AREA)
# ---------- code_block_15.designscript (13 lines) ----------
{
"ExcelDataWithNoHead": _ExcelDataWithNoHead,
"SpaceID": _SpaceID,
"SpaceName": _SpaceName,
"AdjacentSpaces": _AdjacentSpaces,
"DepartmentID": _DepartmentID,
"Department": _Department,
"Level": _Level,
"Width": _Width,
"Length": _Length,
"Height": _Height,
"Area": _Area
};
# ----------------------------------------
extendsChildDictionaryFromParent_2 = Custom[ExtendsChildDictionaryFromParent](ParentDic=code_block_15, ChildDic=extendsChildDictionaryFromParent.dictionary)

# group: Level에 따라 Z 값 Dictionary 추출
code_block_16 = CodeBlock(InputDic=extendsChildDictionaryFromParent_2.dictionary) { _InputDic; }
code_block_17 = CodeBlock { "Level"; }
valueAtKey = DesignScript.Builtin.Dictionary.ValueAtKey(dictionary=code_block_16, key=code_block_17)
lev_2 = Watch(valueAtKey)
uniqueItems = List.UniqueItems(list=lev_2)
code_block_18 = CodeBlock { -2000..4000..2000; }
byKeysValues = DesignScript.Builtin.Dictionary.ByKeysValues(keys=uniqueItems, values=code_block_18)
watch_2 = Watch(byKeysValues)
valueAtKey_2 = DesignScript.Builtin.Dictionary.ValueAtKey(dictionary=watch_2, key=lev_2)
z_값_lev_에서_추출 = Watch(valueAtKey_2)
code_block_19 = CodeBlock(ZvalueFromLevel=z_값_lev_에서_추출)
# ---------- code_block_19.designscript (3 lines) ----------
{
"ZvalueFromLevel": _ZvalueFromLevel
};
# ----------------------------------------
extendsChildDictionaryFromParent_3 = Custom[ExtendsChildDictionaryFromParent](ParentDic=code_block_16, ChildDic=code_block_19)

# group: 룸 BoundingBox 포인트 추출
code_block_20 = CodeBlock(InputDic=extendsChildDictionaryFromParent_3.dictionary) { _InputDic; }
code_block_21 = CodeBlock { "RoomBoundary"; }
valueAtKey_3 = DesignScript.Builtin.Dictionary.ValueAtKey(dictionary=code_block_20, key=code_block_21)
byGeometry = BoundingBox.ByGeometry(geom=valueAtKey_3)
minPoint = BoundingBox.MinPoint(boundingBox=byGeometry)
X = Point.X(point=minPoint)
maxPoint = BoundingBox.MaxPoint(boundingBox=byGeometry)
X_2 = Point.X(point=maxPoint)
code_block_22 = CodeBlock { 500; }
code_block_23 = CodeBlock(a=X, b=X_2, x=code_block_22) { a..b..x; }
Y = Point.Y(point=minPoint)
Y_2 = Point.Y(point=maxPoint)
code_block_24 = CodeBlock { 500; }
code_block_25 = CodeBlock(a=Y, b=Y_2, x=code_block_24) { a..b..x; }
byCoordinates = Point.ByCoordinates(x=code_block_23, y=code_block_25, lacing=CrossProduct)
flatten_2 = List.Flatten(list=byCoordinates)
code_block_26 = CodeBlock(GridPointOfBoundingBox=flatten_2)
# ---------- code_block_26.designscript (3 lines) ----------
{
"GridPointOfBoundingBox": _GridPointOfBoundingBox
};
# ----------------------------------------
extendsChildDictionaryFromParent_4 = Custom[ExtendsChildDictionaryFromParent](ParentDic=code_block_20, ChildDic=code_block_26)

# group: 고정부/변동부 구별
code_block_27 = CodeBlock(InputDic=extendsChildDictionaryFromParent_4.dictionary) { _InputDic; }
code_block_28 = CodeBlock { "DepartmentID"; }
valueAtKey_4 = DesignScript.Builtin.Dictionary.ValueAtKey(dictionary=code_block_27, key=code_block_28)
# note: 3 = Path V = 계단
department_id_2 = Watch(valueAtKey_4)
code_block_29 = CodeBlock { [3,5,6]; }
eq = department_id_2 == code_block_29@L1
boolean = BoolSelector(true)
allIndicesOf = List.AllIndicesOf(list=eq@L2, item=boolean)
boolean_2 = BoolSelector(false)
allIndicesOf_2 = List.AllIndicesOf(list=eq@L2, item=boolean_2)
flatten_3 = List.Flatten(list=allIndicesOf_2)
uniqueItems_2 = List.UniqueItems(list=flatten_3)
flatten_4 = List.Flatten(list=allIndicesOf)
setDifference = List.SetDifference(list1=uniqueItems_2, list2=flatten_4)
code_block_30 = CodeBlock(FixedPartIndex=allIndicesOf, NonFixedPartIndex=setDifference)
# ---------- code_block_30.designscript (4 lines) ----------
{
"FixedPartIndex": _FixedPartIndex,
"NonFixedPartIndex": _NonFixedPartIndex
};
# ----------------------------------------
extendsChildDictionaryFromParent_5 = Custom[ExtendsChildDictionaryFromParent](ParentDic=code_block_27, ChildDic=code_block_30)

# group: 층별 고정부 Point Index 추출
code_block_31 = CodeBlock(InputDic=extendsChildDictionaryFromParent_5.dictionary) { _InputDic; }
ofRepeatedItem = List.OfRepeatedItem()  # unwired: item, amount
code_block_32 = CodeBlock { "Level"; }
valueAtKey_5 = DesignScript.Builtin.Dictionary.ValueAtKey(dictionary=code_block_31, key=code_block_32)
code_block_33 = CodeBlock { "FixedPartIndex"; }
valueAtKey_6 = DesignScript.Builtin.Dictionary.ValueAtKey(dictionary=code_block_31, key=code_block_33)
getItemAtIndex_11 = List.GetItemAtIndex(list=valueAtKey_5, index=valueAtKey_6)
uniqueItems_3 = List.UniqueItems(list=getItemAtIndex_11@L2)
count = List.Count(list=uniqueItems_3@L3)
code_block_34 = CodeBlock { 0; }
code_block_35 = CodeBlock { "GridPointOfBoundingBox"; }
valueAtKey_7 = DesignScript.Builtin.Dictionary.ValueAtKey(dictionary=code_block_31, key=code_block_35)
count_2 = List.Count(list=valueAtKey_7)
watch_3 = Watch(count_2)
code_block_36 = CodeBlock { "FixedPartSeed"; }
valueAtKey_8 = DesignScript.Builtin.Dictionary.ValueAtKey(dictionary=code_block_31, key=code_block_36)
randomList = Math.RandomList(amount=count, value1=code_block_34, value2=watch_3, seed=valueAtKey_8)
flatten_5 = List.Flatten(list=randomList)
count_3 = List.Count(list=uniqueItems_3@L2)
laceShortest = List.LaceShortest(combineFunction=ofRepeatedItem, list0=flatten_5, list1=count_3)
watch_4 = Watch(laceShortest)
round = Math.Round(number=watch_4)
code_block_37 = CodeBlock(FixedPartPointIndex=round)
# ---------- code_block_37.designscript (3 lines) ----------
{
"FixedPartPointIndex": _FixedPartPointIndex
};
# ----------------------------------------
extendsChildDictionaryFromParent_6 = Custom[ExtendsChildDictionaryFromParent](ParentDic=code_block_31, ChildDic=code_block_37)

# group: 층별 변동부 Point Index 추출
code_block_38 = CodeBlock(InputDic=extendsChildDictionaryFromParent_6.dictionary) { _InputDic; }
code_block_39 = CodeBlock { "Level"; }
valueAtKey_9 = DesignScript.Builtin.Dictionary.ValueAtKey(dictionary=code_block_38, key=code_block_39)
code_block_40 = CodeBlock { "NonFixedPartIndex"; }
valueAtKey_10 = DesignScript.Builtin.Dictionary.ValueAtKey(dictionary=code_block_38, key=code_block_40)
getItemAtIndex_12 = List.GetItemAtIndex(list=valueAtKey_9, index=valueAtKey_10)
uniqueItems_4 = List.UniqueItems(list=getItemAtIndex_12)
eq_2 = uniqueItems_4 == getItemAtIndex_12  # lacing=CrossProduct
countTrue = List.CountTrue(list=eq_2@L2)
sum = Math.Sum(values=countTrue)
code_block_41 = CodeBlock { 0; }
code_block_42 = CodeBlock { "GridPointOfBoundingBox"; }
valueAtKey_11 = DesignScript.Builtin.Dictionary.ValueAtKey(dictionary=code_block_38, key=code_block_42)
count_4 = List.Count(list=valueAtKey_11)
watch_5 = Watch(count_4)
code_block_43 = CodeBlock { "NonFixedPartSeed"; }
valueAtKey_12 = DesignScript.Builtin.Dictionary.ValueAtKey(dictionary=code_block_38, key=code_block_43)
randomList_2 = Math.RandomList(amount=sum, value1=code_block_41, value2=watch_5, seed=valueAtKey_12)
watch_6 = Watch(randomList_2)
round_2 = Math.Round(number=watch_6)
code_block_44 = CodeBlock(NonFixedPartPointIndex=round_2)
# ---------- code_block_44.designscript (3 lines) ----------
{
"NonFixedPartPointIndex": _NonFixedPartPointIndex
};
# ----------------------------------------
extendsChildDictionaryFromParent_7 = Custom[ExtendsChildDictionaryFromParent](ParentDic=code_block_38, ChildDic=code_block_44)

# group: Total Room Point Index List 추출
code_block_45 = CodeBlock(InputDic=extendsChildDictionaryFromParent_7.dictionary) { _InputDic; }
code_block_46 = CodeBlock { "FixedPartPointIndex"; }
valueAtKey_13 = DesignScript.Builtin.Dictionary.ValueAtKey(dictionary=code_block_45, key=code_block_46)
firstItem_2 = List.FirstItem(list=valueAtKey_13@L2)
code_block_47 = CodeBlock { "DepartmentID"; }
valueAtKey_14 = DesignScript.Builtin.Dictionary.ValueAtKey(dictionary=code_block_45, key=code_block_47)
count_5 = List.Count(list=valueAtKey_14)
code_block_48 = CodeBlock(a=count_5) { a-1; }
code_block_49 = CodeBlock(a=code_block_48) { 0..a..1; }
code_block_50 = CodeBlock { "FixedPartIndex"; }
valueAtKey_15 = DesignScript.Builtin.Dictionary.ValueAtKey(dictionary=code_block_45, key=code_block_50)
replaceItemAtIndex = Custom[List.ReplaceItemAtIndex+](seq=code_block_49, indices=valueAtKey_15, replacement=valueAtKey_13)  # package Clockwork for Dynamo 2.x; Replaces the item at a given index of a list by another item. Unlike the OOTB node, it can replace items at multiple indeces.
code_block_51 = CodeBlock { "NonFixedPartIndex"; }
valueAtKey_16 = DesignScript.Builtin.Dictionary.ValueAtKey(dictionary=code_block_45, key=code_block_51)
code_block_52 = CodeBlock { "NonFixedPartPointIndex"; }
valueAtKey_17 = DesignScript.Builtin.Dictionary.ValueAtKey(dictionary=code_block_45, key=code_block_52)
replaceItemAtIndex_2 = Custom[List.ReplaceItemAtIndex+](seq=replaceItemAtIndex, indices=valueAtKey_16, replacement=valueAtKey_17)
point_index_list_추출 = Watch(replaceItemAtIndex_2)
code_block_53 = CodeBlock(TotalRoomPointIndexList=point_index_list_추출)
# ---------- code_block_53.designscript (3 lines) ----------
{
"TotalRoomPointIndexList": _TotalRoomPointIndexList
};
# ----------------------------------------
extendsChildDictionaryFromParent_8 = Custom[ExtendsChildDictionaryFromParent](ParentDic=code_block_45, ChildDic=code_block_53)

# group: Center Points
code_block_54 = CodeBlock(InputDic=extendsChildDictionaryFromParent_8.dictionary) { _InputDic; }
code_block_55 = CodeBlock { "GridPointOfBoundingBox"; }
valueAtKey_18 = DesignScript.Builtin.Dictionary.ValueAtKey(dictionary=code_block_54, key=code_block_55)
code_block_56 = CodeBlock { "TotalRoomPointIndexList"; }
valueAtKey_19 = DesignScript.Builtin.Dictionary.ValueAtKey(dictionary=code_block_54, key=code_block_56)
flatten_6 = List.Flatten(list=valueAtKey_19)
getItemAtIndex_13 = List.GetItemAtIndex(list=valueAtKey_18, index=flatten_6)
X_3 = Point.X(point=getItemAtIndex_13)
Y_3 = Point.Y(point=getItemAtIndex_13)
code_block_57 = CodeBlock { "ZvalueFromLevel"; }
valueAtKey_20 = DesignScript.Builtin.Dictionary.ValueAtKey(dictionary=code_block_54, key=code_block_57)
byCoordinates_2 = Point.ByCoordinates(x=X_3, y=Y_3, z=valueAtKey_20, lacing=Shortest)
code_block_58 = CodeBlock(TotalRoomCenterPoint=byCoordinates_2)
# ---------- code_block_58.designscript (3 lines) ----------
{
"TotalRoomCenterPoint": _TotalRoomCenterPoint
};
# ----------------------------------------
extendsChildDictionaryFromParent_9 = Custom[ExtendsChildDictionaryFromParent](ParentDic=code_block_54, ChildDic=code_block_58)

# group: Department 별 Boolean Index
code_block_59 = CodeBlock(InputDic=extendsChildDictionaryFromParent_9.dictionary) { _InputDic; }
code_block_60 = CodeBlock { "ExcelDataWithNoHead"; }
valueAtKey_21 = DesignScript.Builtin.Dictionary.ValueAtKey(dictionary=code_block_59, key=code_block_60)
code_block_61 = CodeBlock { 2; }
getItemAtIndex_14 = List.GetItemAtIndex(list=valueAtKey_21, index=code_block_61)
watch_7 = Watch(getItemAtIndex_14)
uniqueItems_5 = List.UniqueItems(list=watch_7)
eq_3 = uniqueItems_5 == watch_7  # lacing=CrossProduct
code_block_62 = CodeBlock(BlnIndexPerDepartment=eq_3)
# ---------- code_block_62.designscript (3 lines) ----------
{
"BlnIndexPerDepartment": _BlnIndexPerDepartment
};
# ----------------------------------------
extendsChildDictionaryFromParent_10 = Custom[ExtendsChildDictionaryFromParent](ParentDic=code_block_59, ChildDic=code_block_62)

# group: Department로 List 분류-1
code_block_63 = CodeBlock(InputDic=extendsChildDictionaryFromParent_10.dictionary) { _InputDic; }
code_block_64 = CodeBlock { "SpaceID"; }
valueAtKey_22 = DesignScript.Builtin.Dictionary.ValueAtKey(dictionary=code_block_63, key=code_block_64)
space_id_2 = Watch(valueAtKey_22)
code_block_65 = CodeBlock { "BlnIndexPerDepartment"; }
valueAtKey_23 = DesignScript.Builtin.Dictionary.ValueAtKey(dictionary=code_block_63, key=code_block_65)
filterByBoolMask = List.FilterByBoolMask(list=space_id_2, mask=valueAtKey_23@L2)
watch_8 = Watch(filterByBoolMask.in)
code_block_66 = CodeBlock { "TotalRoomCenterPoint"; }
valueAtKey_24 = DesignScript.Builtin.Dictionary.ValueAtKey(dictionary=code_block_63, key=code_block_66)
filterByBoolMask_2 = List.FilterByBoolMask(list=valueAtKey_24, mask=valueAtKey_23@L2)
watch_9 = Watch(filterByBoolMask_2.in)
code_block_67 = CodeBlock { "Area"; }
valueAtKey_25 = DesignScript.Builtin.Dictionary.ValueAtKey(dictionary=code_block_63, key=code_block_67)
AREA_2 = Watch(valueAtKey_25)
code_block_68 = CodeBlock(a=AREA_2) { a/2; }
filterByBoolMask_3 = List.FilterByBoolMask(list=code_block_68, mask=valueAtKey_23@L2)
watch_10 = Watch(filterByBoolMask_3.in)
code_block_69 = CodeBlock(SpaceIDPerDepartment=watch_8, RoomCenterPointPerDe=watch_9, AreaPerDepartment=watch_10)
# ---------- code_block_69.designscript (5 lines) ----------
{
"SpaceIDPerDepartment": _SpaceIDPerDepartment,
"RoomCenterPointPerDepartment": _RoomCenterPointPerDepartment,
"AreaPerDepartment": _AreaPerDepartment
};
# ----------------------------------------
extendsChildDictionaryFromParent_11 = Custom[ExtendsChildDictionaryFromParent](ParentDic=code_block_63, ChildDic=code_block_69)

code_block_70 = CodeBlock(InputDic=extendsChildDictionaryFromParent_9.dictionary) { _InputDic; }
code_block_71 = CodeBlock { "SpaceID"; }
valueAtKey_26 = DesignScript.Builtin.Dictionary.ValueAtKey(dictionary=code_block_70, key=code_block_71)
code_block_72 = CodeBlock(BoxSpaceID=valueAtKey_26)  # unwired: BoxSpaceName, BoxDepartment, BoxWidth, BoxLength, BoxHeigth, BoxAdjacentSpaces, BoxLevel, BoxGeometry, BoxCenterPoint
# ---------- code_block_72.designscript (13 lines) ----------
///매스 클래스
{
"BoxSpaceID": _BoxSpaceID,
"BoxSpaceName": _BoxSpaceName,
"BoxDepartment": _BoxDepartment,
"BoxWidth": _BoxWidth,
"BoxLength": _BoxLength,
"BoxHeigth": _BoxHeigth,
"BoxAdjacentSpaces": _BoxAdjacentSpaces,
"BoxLevel": _BoxLevel,
"BoxGeometry": _BoxGeometry,
"BoxCenterPoint": _BoxCenterPoint
};
# ----------------------------------------
watch_11 = Watch(extendsChildDictionaryFromParent_9.key)
code_block_73 = CodeBlock(InputDic=code_block_15) { _InputDic; }
code_block_74 = CodeBlock { "Width"; }
valueAtKey_27 = DesignScript.Builtin.Dictionary.ValueAtKey(dictionary=code_block_73, key=code_block_74)
code_block_75 = CodeBlock { "Length"; }
valueAtKey_28 = DesignScript.Builtin.Dictionary.ValueAtKey(dictionary=code_block_73, key=code_block_75)
code_block_76 = CodeBlock { "Height"; }
valueAtKey_29 = DesignScript.Builtin.Dictionary.ValueAtKey(dictionary=code_block_73, key=code_block_76)
byLengths = Cuboid.ByLengths(width=valueAtKey_27, length=valueAtKey_28, height=valueAtKey_29)
centroid = Solid.Centroid(solid=byLengths)

# group: Center Points
code_block_77 = CodeBlock(InputDic=extendsChildDictionaryFromParent_8.dictionary) { _InputDic; }
code_block_78 = CodeBlock { "GridPointOfBoundingBox"; }
valueAtKey_30 = DesignScript.Builtin.Dictionary.ValueAtKey(dictionary=code_block_77, key=code_block_78)
code_block_79 = CodeBlock { "TotalRoomPointIndexList"; }
valueAtKey_31 = DesignScript.Builtin.Dictionary.ValueAtKey(dictionary=code_block_77, key=code_block_79)
flatten_7 = List.Flatten(list=valueAtKey_31)
getItemAtIndex_15 = List.GetItemAtIndex(list=valueAtKey_30, index=flatten_7)
X_4 = Point.X(point=getItemAtIndex_15)
Y_4 = Point.Y(point=getItemAtIndex_15)
code_block_80 = CodeBlock { "ZvalueFromLevel"; }
valueAtKey_32 = DesignScript.Builtin.Dictionary.ValueAtKey(dictionary=code_block_77, key=code_block_80)
byCoordinates_3 = Point.ByCoordinates(x=X_4, y=Y_4, z=valueAtKey_32, lacing=Shortest)
code_block_81 = CodeBlock(TotalRoomCenterPoint=byCoordinates_3)  # same code as code_block_58
extendsChildDictionaryFromParent_12 = Custom[ExtendsChildDictionaryFromParent](ParentDic=code_block_77, ChildDic=code_block_81)

code_block_82 = CodeBlock { "SpaceID"; }
valueAtKey_33 = DesignScript.Builtin.Dictionary.ValueAtKey(dictionary=code_block_73, key=code_block_82)
code_block_83 = CodeBlock { "SpaceName"; }
valueAtKey_34 = DesignScript.Builtin.Dictionary.ValueAtKey(dictionary=code_block_73, key=code_block_83)
code_block_84 = CodeBlock { "AdjacentSpaces"; }
valueAtKey_35 = DesignScript.Builtin.Dictionary.ValueAtKey(dictionary=code_block_73, key=code_block_84)
code_block_85 = CodeBlock { "DepartmentID"; }
valueAtKey_36 = DesignScript.Builtin.Dictionary.ValueAtKey(dictionary=code_block_73, key=code_block_85)
code_block_86 = CodeBlock { "Department"; }
valueAtKey_37 = DesignScript.Builtin.Dictionary.ValueAtKey(dictionary=code_block_73, key=code_block_86)
code_block_87 = CodeBlock { "Level"; }
valueAtKey_38 = DesignScript.Builtin.Dictionary.ValueAtKey(dictionary=code_block_73, key=code_block_87)
code_block_88 = CodeBlock { "Area"; }
valueAtKey_39 = DesignScript.Builtin.Dictionary.ValueAtKey(dictionary=code_block_73, key=code_block_88)
code_block_89 = CodeBlock(BoxSpaceID=valueAtKey_33, BoxSpaceName=valueAtKey_34, BoxAdjacentSpaces=valueAtKey_35, BoxDepartmentID=valueAtKey_36, BoxDepartment=valueAtKey_37, BoxLevel=valueAtKey_38, BoxWidth=valueAtKey_27, BoxLength=valueAtKey_28, BoxHeight=valueAtKey_29, BoxArea=valueAtKey_39)
# ---------- code_block_89.designscript (15 lines) ----------
///Box Class Primary
{
"BoxSpaceID": _BoxSpaceID,
"BoxSpaceName": _BoxSpaceName,
"BoxAdjacentSpaces": _BoxAdjacentSpaces,
"BoxDepartmentID": _BoxDepartmentID,
"BoxDepartment": _BoxDepartment,
"BoxLevel": _BoxLevel,
"BoxWidth": _BoxWidth,
"BoxLength": _BoxLength,
"BoxHeight": _BoxHeight,
"BoxArea": _BoxArea
///"BoxGeometry": _BoxGeometry,
///"BoxCenterPoint": _BoxCenterPoint
};
# ----------------------------------------
code_block_90 = CodeBlock(BoxClass_Primary=code_block_89)
# ---------- code_block_90.designscript (3 lines) ----------
{
"BoxClass_Primary": _BoxClass_Primary
};
# ----------------------------------------
extendsChildDictionaryFromParent_13 = Custom[ExtendsChildDictionaryFromParent](ParentDic=extendsChildDictionaryFromParent.dictionary, ChildDic=code_block_90)

# group: Level에 따라 Z 값 Dictionary 추출
code_block_91 = CodeBlock(InputDic=extendsChildDictionaryFromParent_13.dictionary) { _InputDic; }
code_block_92 = CodeBlock { "BoxClass_Primary"; }
valueAtKey_40 = DesignScript.Builtin.Dictionary.ValueAtKey(dictionary=code_block_91, key=code_block_92)
code_block_93 = CodeBlock { "BoxLevel"; }
valueAtKey_41 = DesignScript.Builtin.Dictionary.ValueAtKey(dictionary=valueAtKey_40, key=code_block_93)
lev_3 = Watch(valueAtKey_41)
uniqueItems_6 = List.UniqueItems(list=lev_3)
code_block_94 = CodeBlock { [-6000,0,6000,12000]; }
byKeysValues_2 = DesignScript.Builtin.Dictionary.ByKeysValues(keys=uniqueItems_6, values=code_block_94)
watch_12 = Watch(byKeysValues_2)
valueAtKey_42 = DesignScript.Builtin.Dictionary.ValueAtKey(dictionary=watch_12, key=lev_3)
z_값_lev_에서_추출_2 = Watch(valueAtKey_42)
code_block_95 = CodeBlock(BoxZvalue=z_값_lev_에서_추출_2)
# ---------- code_block_95.designscript (3 lines) ----------
{
"BoxZvalue": _BoxZvalue
};
# ----------------------------------------
extendsChildDictionaryFromParent_14 = Custom[ExtendsChildDictionaryFromParent](ParentDic=valueAtKey_40, ChildDic=code_block_95)
setValueAtKeys = DesignScript.Builtin.Dictionary.SetValueAtKeys(dictionary=code_block_91, keys=code_block_92, values=extendsChildDictionaryFromParent_14.dictionary)

# group: 룸 BoundingBox 포인트 추출
code_block_96 = CodeBlock(InputDic=setValueAtKeys) { _InputDic; }
code_block_97 = CodeBlock { "RoomBoundary"; }
valueAtKey_43 = DesignScript.Builtin.Dictionary.ValueAtKey(dictionary=code_block_96, key=code_block_97)
byGeometry_2 = BoundingBox.ByGeometry(geom=valueAtKey_43)
minPoint_2 = BoundingBox.MinPoint(boundingBox=byGeometry_2)
X_5 = Point.X(point=minPoint_2)
maxPoint_2 = BoundingBox.MaxPoint(boundingBox=byGeometry_2)
X_6 = Point.X(point=maxPoint_2)
code_block_98 = CodeBlock { 500; }
code_block_99 = CodeBlock(a=X_5, b=X_6, x=code_block_98) { a..b..x; }
Y_5 = Point.Y(point=minPoint_2)
Y_6 = Point.Y(point=maxPoint_2)
code_block_100 = CodeBlock { 500; }
code_block_101 = CodeBlock(a=Y_5, b=Y_6, x=code_block_100) { a..b..x; }
byCoordinates_4 = Point.ByCoordinates(x=code_block_99, y=code_block_101, lacing=CrossProduct)
flatten_8 = List.Flatten(list=byCoordinates_4)
code_block_102 = CodeBlock(GridPointOfBoundingBox=flatten_8)  # same code as code_block_26
extendsChildDictionaryFromParent_15 = Custom[ExtendsChildDictionaryFromParent](ParentDic=code_block_96, ChildDic=code_block_102)

# group: Fixed Part 종류별 카운팅 및 Seed Random 값 부여
code_block_103 = CodeBlock(InputDic=extendsChildDictionaryFromParent_15.dictionary) { _InputDic; }
code_block_104 = CodeBlock { "BoxSeed(fixed)"; }
code_block_105 = CodeBlock { "BoxClass_Primary"; }
valueAtKey_44 = DesignScript.Builtin.Dictionary.ValueAtKey(dictionary=code_block_103, key=code_block_105)
components = DesignScript.Builtin.Dictionary.Components(dictionary=valueAtKey_44)
watch_13 = Watch(components.keys)
addItemToEnd = List.AddItemToEnd(item=code_block_104, list=watch_13)
code_block_106 = CodeBlock { "BoxDepartment"; }
valueAtKey_45 = DesignScript.Builtin.Dictionary.ValueAtKey(dictionary=valueAtKey_44, key=code_block_106)
code_block_107 = CodeBlock()
# ---------- code_block_107.designscript (6 lines) ----------
[
"PATHV1",
"PATHV2",
"PATHV3"
];
[];
# ----------------------------------------
contains = String.Contains(str=valueAtKey_45, searchFor=code_block_107.out0@@L1)
boolean_3 = BoolSelector(true)
allIndicesOf_3 = List.AllIndicesOf(list=contains@@L2, item=boolean_3)
count_6 = List.Count(list=allIndicesOf_3@L3)
code_block_108 = CodeBlock { 0; }
code_block_109 = CodeBlock { "GridPointOfBoundingBox"; }
valueAtKey_46 = DesignScript.Builtin.Dictionary.ValueAtKey(dictionary=code_block_103, key=code_block_109)
count_7 = List.Count(list=valueAtKey_46)
watch_14 = Watch(count_7)
code_block_110 = CodeBlock { "FixedPartSeed"; }
valueAtKey_47 = DesignScript.Builtin.Dictionary.ValueAtKey(dictionary=code_block_103, key=code_block_110)
randomList_3 = Math.RandomList(amount=count_6, value1=code_block_108, value2=watch_14, seed=valueAtKey_47)
count_8 = List.Count(list=allIndicesOf_3@L2)
ofRepeatedItem_2 = List.OfRepeatedItem(item=randomList_3@L1, amount=count_8@L1)
flatten_9 = List.Flatten(list=ofRepeatedItem_2)
round_3 = Math.Round(number=flatten_9)
transpose_2 = List.Transpose(lists=components.values)
flatten_10 = List.Flatten(list=allIndicesOf_3)
list_getitematindex_fixed = List.GetItemAtIndex(list=transpose_2, index=flatten_10)
addItemToEnd_2 = List.AddItemToEnd(item=round_3@L1, list=list_getitematindex_fixed@L2)
transpose_3 = List.Transpose(lists=addItemToEnd_2)
byKeysValues_3 = DesignScript.Builtin.Dictionary.ByKeysValues(keys=addItemToEnd, values=transpose_3)
code_block_111 = CodeBlock(BoxClass_fixedpart=byKeysValues_3)
# ---------- code_block_111.designscript (3 lines) ----------
{
"BoxClass_fixedpart": _BoxClass_fixedpart
};
# ----------------------------------------
extendsChildDictionaryFromParent_16 = Custom[ExtendsChildDictionaryFromParent](ParentDic=code_block_103, ChildDic=code_block_111)

# group: Fixed Part 형상 배치 by Seed(회전 고려)
code_block_112 = CodeBlock(InputDic=extendsChildDictionaryFromParent_16.dictionary) { _InputDic; }
code_block_113 = CodeBlock { "BoxClass_fixedpart"; }
valueAtKey_48 = DesignScript.Builtin.Dictionary.ValueAtKey(dictionary=code_block_112, key=code_block_113)
code_block_114 = CodeBlock { "BoxZvalue"; }
valueAtKey_49 = DesignScript.Builtin.Dictionary.ValueAtKey(dictionary=valueAtKey_48, key=code_block_114)
uniqueItems_7 = List.UniqueItems(list=valueAtKey_49)
code_block_115 = CodeBlock { "BoxClass_fixedpart"; }
code_block_116 = CodeBlock { "BoxGeometry"; }
components_2 = DesignScript.Builtin.Dictionary.Components(dictionary=valueAtKey_48)
addItemToEnd_3 = List.AddItemToEnd(item=code_block_116, list=components_2.keys)
code_block_117 = CodeBlock { "GridPointOfBoundingBox"; }
valueAtKey_50 = DesignScript.Builtin.Dictionary.ValueAtKey(dictionary=code_block_112, key=code_block_117)
code_block_118 = CodeBlock { "BoxSeed(fixed)"; }
valueAtKey_51 = DesignScript.Builtin.Dictionary.ValueAtKey(dictionary=valueAtKey_48, key=code_block_118)
getItemAtIndex_16 = List.GetItemAtIndex(list=valueAtKey_50, index=valueAtKey_51)
X_7 = Point.X(point=getItemAtIndex_16)
Y_7 = Point.Y(point=getItemAtIndex_16)
firstItem_3 = List.FirstItem(list=valueAtKey_49)
code_block_119 = CodeBlock(i=valueAtKey_49, j=firstItem_3) { i+Math.Abs(j/2); }
byCoordinates_5 = Point.ByCoordinates(x=X_7, y=Y_7, z=code_block_119)
code_block_120 = CodeBlock { "BoxWidth"; }
valueAtKey_52 = DesignScript.Builtin.Dictionary.ValueAtKey(dictionary=valueAtKey_48, key=code_block_120)
code_block_121 = CodeBlock { "BoxLength"; }
valueAtKey_53 = DesignScript.Builtin.Dictionary.ValueAtKey(dictionary=valueAtKey_48, key=code_block_121)
code_block_122 = CodeBlock { "BoxHeight"; }
valueAtKey_54 = DesignScript.Builtin.Dictionary.ValueAtKey(dictionary=valueAtKey_48, key=code_block_122)
byLengths_2 = Cuboid.ByLengths(origin=byCoordinates_5, width=valueAtKey_52, length=valueAtKey_53, height=valueAtKey_54)
centroid_2 = Solid.Centroid(solid=byLengths_2)
ZAxis = Vector.ZAxis()
code_block_123 = CodeBlock { "BoxClass_Primary"; }
valueAtKey_55 = DesignScript.Builtin.Dictionary.ValueAtKey(dictionary=code_block_112, key=code_block_123)
code_block_124 = CodeBlock { "BoxDepartment"; }
valueAtKey_56 = DesignScript.Builtin.Dictionary.ValueAtKey(dictionary=valueAtKey_55, key=code_block_124)
code_block_125 = CodeBlock()  # same code as code_block_107
contains_2 = String.Contains(str=valueAtKey_56, searchFor=code_block_125.out0@@L1)
boolean_4 = BoolSelector(true)
allIndicesOf_4 = List.AllIndicesOf(list=contains_2@@L2, item=boolean_4)
count_9 = List.Count(list=allIndicesOf_4)
code_block_126 = CodeBlock { 0; }
code_block_127 = CodeBlock { 90; }
code_block_128 = CodeBlock { "RotatingSeed"; }
valueAtKey_57 = DesignScript.Builtin.Dictionary.ValueAtKey(dictionary=code_block_112, key=code_block_128)
randomList_4 = Math.RandomList(amount=count_9, value1=code_block_126, value2=code_block_127, seed=valueAtKey_57)
code_block_129 = CodeBlock(i=randomList_4) { i>=45; }
code_block_130 = CodeBlock { 90; 0; }
if_ = If(test=code_block_129, true=code_block_130.out0, false=code_block_130.out1)
count_10 = List.Count(list=allIndicesOf_4@L2)
ofRepeatedItem_3 = List.OfRepeatedItem(item=if_@L1, amount=count_10@L1)
flatten_11 = List.Flatten(list=ofRepeatedItem_3)
rotate = Geometry.Rotate(geometry=byLengths_2, origin=centroid_2, axis=ZAxis, degrees=flatten_11)
addItemToEnd_4 = List.AddItemToEnd(item=rotate, list=components_2.values)
byKeysValues_4 = DesignScript.Builtin.Dictionary.ByKeysValues(keys=addItemToEnd_3, values=addItemToEnd_4)
setValueAtKeys_2 = DesignScript.Builtin.Dictionary.SetValueAtKeys(dictionary=code_block_112, keys=code_block_115, values=byKeysValues_4)

keys = DesignScript.Builtin.Dictionary.Keys(dictionary=byKeysValues_3)

# group: 레벨 별 고정부 비점유 포인트 추출
code_block_131 = CodeBlock(InputDic=setValueAtKeys_2) { _InputDic; }
code_block_132 = CodeBlock { "GridPointOfBoundingBox"; }
valueAtKey_58 = DesignScript.Builtin.Dictionary.ValueAtKey(dictionary=code_block_131, key=code_block_132)
X_8 = Point.X(point=valueAtKey_58)
Y_8 = Point.Y(point=valueAtKey_58)
code_block_133 = CodeBlock { "BoxClass_fixedpart"; }
valueAtKey_59 = DesignScript.Builtin.Dictionary.ValueAtKey(dictionary=code_block_131, key=code_block_133)
code_block_134 = CodeBlock { "BoxZvalue"; }
valueAtKey_60 = DesignScript.Builtin.Dictionary.ValueAtKey(dictionary=valueAtKey_59, key=code_block_134)
uniqueItems_8 = List.UniqueItems(list=valueAtKey_60)
byCoordinates_6 = Point.ByCoordinates(x=X_8, y=Y_8, z=uniqueItems_8@L1)
code_block_135 = CodeBlock { "BoxGeometry"; }
valueAtKey_61 = DesignScript.Builtin.Dictionary.ValueAtKey(dictionary=valueAtKey_59, key=code_block_135)
byUnion = Solid.ByUnion(solids=valueAtKey_61)
doesIntersect = Geometry.DoesIntersect(geometry=byCoordinates_6, other=byUnion)
filterByBoolMask_4 = List.FilterByBoolMask(list=byCoordinates_6@L2, mask=doesIntersect@L2)
watch_15 = Watch(filterByBoolMask_4.out)
code_block_136 = CodeBlock(RestGridPointByLevel=watch_15)
# ---------- code_block_136.designscript (3 lines) ----------
{
"RestGridPointByLevel": _RestGridPointByLevel
};
# ----------------------------------------
extendsChildDictionaryFromParent_17 = Custom[ExtendsChildDictionaryFromParent](ParentDic=code_block_131, ChildDic=code_block_136)

code_block_137 = CodeBlock(i=extendsChildDictionaryFromParent_17.dictionary) { i; }

# group: Non-Fixed Part 종류별 카운팅
code_block_138 = CodeBlock(InputDic=code_block_137) { _InputDic; }
code_block_139 = CodeBlock { "BoxClass_Primary"; }
valueAtKey_62 = DesignScript.Builtin.Dictionary.ValueAtKey(dictionary=code_block_138, key=code_block_139)
components_3 = DesignScript.Builtin.Dictionary.Components(dictionary=valueAtKey_62)
transpose_4 = List.Transpose(lists=components_3.values)
code_block_140 = CodeBlock { "BoxSpaceID"; }
valueAtKey_63 = DesignScript.Builtin.Dictionary.ValueAtKey(dictionary=valueAtKey_62, key=code_block_140)
code_block_141 = CodeBlock { "BoxClass_fixedpart"; }
valueAtKey_64 = DesignScript.Builtin.Dictionary.ValueAtKey(dictionary=code_block_138, key=code_block_141)
code_block_142 = CodeBlock { "BoxSpaceID"; }
valueAtKey_65 = DesignScript.Builtin.Dictionary.ValueAtKey(dictionary=valueAtKey_64, key=code_block_142)
setDifference_2 = List.SetDifference(list1=valueAtKey_63, list2=valueAtKey_65)
getItemAtIndex_17 = List.GetItemAtIndex(list=transpose_4, index=setDifference_2)
transpose_5 = List.Transpose(lists=getItemAtIndex_17)
byKeysValues_5 = DesignScript.Builtin.Dictionary.ByKeysValues(keys=components_3.keys, values=transpose_5)
code_block_143 = CodeBlock(BoxClass_nonfixedpart=byKeysValues_5)
# ---------- code_block_143.designscript (3 lines) ----------
{
"BoxClass_nonfixedpart": _BoxClass_nonfixedpart
};
# ----------------------------------------
extendsChildDictionaryFromParent_18 = Custom[ExtendsChildDictionaryFromParent](ParentDic=code_block_138, ChildDic=code_block_143)

# group: Non-Fixed Part 레벨 별 Seed Random 값 부여
code_block_144 = CodeBlock(InputDic=extendsChildDictionaryFromParent_18.dictionary) { _InputDic; }
code_block_145 = CodeBlock { "BoxClass_nonfixedpart"; }
code_block_146 = CodeBlock { "BoxSeed(nonfixed)"; }
code_block_147 = CodeBlock { "BoxClass_nonfixedpart"; }
valueAtKey_66 = DesignScript.Builtin.Dictionary.ValueAtKey(dictionary=code_block_144, key=code_block_147)
components_4 = DesignScript.Builtin.Dictionary.Components(dictionary=valueAtKey_66)
addItemToEnd_5 = List.AddItemToEnd(item=code_block_146, list=components_4.keys)
code_block_148 = CodeBlock { "BoxClass_nonfixedpart"; }
valueAtKey_67 = DesignScript.Builtin.Dictionary.ValueAtKey(dictionary=code_block_144, key=code_block_148)
code_block_149 = CodeBlock { "BoxLevel"; }
valueAtKey_68 = DesignScript.Builtin.Dictionary.ValueAtKey(dictionary=valueAtKey_67, key=code_block_149)
uniqueItems_9 = List.UniqueItems(list=valueAtKey_68)
allIndicesOf_5 = List.AllIndicesOf(list=valueAtKey_68, item=uniqueItems_9)
count_11 = List.Count(list=allIndicesOf_5@L2)
code_block_150 = CodeBlock { 0; }
code_block_151 = CodeBlock { "RestGridPointByLevel"; }
valueAtKey_69 = DesignScript.Builtin.Dictionary.ValueAtKey(dictionary=code_block_144, key=code_block_151)
count_12 = List.Count(list=valueAtKey_69@L2)
code_block_152 = CodeBlock { "NonFixedPartSeed"; }
valueAtKey_70 = DesignScript.Builtin.Dictionary.ValueAtKey(dictionary=code_block_144, key=code_block_152)
randomList_5 = Math.RandomList(amount=count_11, value1=code_block_150, value2=count_12, seed=valueAtKey_70)
flatten_12 = List.Flatten(list=randomList_5)
components_5 = DesignScript.Builtin.Dictionary.Components(dictionary=valueAtKey_67)
transpose_6 = List.Transpose(lists=components_5.values)
getItemAtIndex_18 = List.GetItemAtIndex(list=transpose_6, index=allIndicesOf_5)
flatten_13 = List.Flatten(list=getItemAtIndex_18@L2)
addItemToEnd_6 = List.AddItemToEnd(item=flatten_12@L1, list=flatten_13@L2)
byKeysValues_6 = DesignScript.Builtin.Dictionary.ByKeysValues(keys=addItemToEnd_5, values=addItemToEnd_6)
setValueAtKeys_3 = DesignScript.Builtin.Dictionary.SetValueAtKeys(dictionary=code_block_144, keys=code_block_145, values=byKeysValues_6)
