# Dynamo graph 0806 space planning test 006CN_mk.dyn (Dynamo 2.10.1.3976)
# packages: GenerativeDesign.Revit 1.7.3.0, GenerativeDesign 1.7.3.0

# group: User Inputs for GDIR
# note: Custom Package: GenerativeDesign v.2021.5.5
select_room_to_load_program_into = DSModelRoomSelection()  # 1 picked in the model; graph input
# note: Retrieve the room's finish boundary.
# Note: The first sublist is the outermost boundary of the room.
finishBoundary = Room.FinishBoundary(room=select_room_to_load_program_into)
remember = Data.Remember(finishBoundary)

# group: Extract room boundary for DynaSpace and cache it in the graph
firstItem = List.FirstItem(list=remember@L3)
startPoint = Curve.StartPoint(curve=firstItem)
flatten = List.Flatten(list=startPoint)
byJoinedCurves = PolyCurve.ByJoinedCurves(curves=firstItem)
code_block = CodeBlock(RoomBoundary=byJoinedCurves)
# ---------- code_block.designscript (3 lines) ----------
{
"RoomBoundary": _RoomBoundary
};
# ----------------------------------------

# group: Excel Data import (package 정리 전)
file_path = Filename(".\space planning test 0802mk 001.xlsx")
file_from_path = FileObject(path=file_path)
string_from_object = FromObject(object=file_from_path)
code_block_2 = CodeBlock { "Sheet1"; "SampleBuildingProgram-Clinic"; false; }
python_script_import_excel_by = Python(IN[0]=string_from_object, IN[1]=code_block_2.out0)  # "Python Script@Import Excel(By OpenpyXl)"; CPython3
# ---------- python_script_import_excel_by.python (50 lines) ----------
# Load the Python Standard and DesignScript Libraries
import sys
import os
#sys.path.append(r'C:\Users\HEC\AppData\Local\Programs\Python\Python39\Lib\site-packages')
#sys.path.append(r'C:\Users\pjmk0\AppData\Local\Programs\Python\Python39\Lib\site-packages')
sys.path.append(os.getenv('LOCALAPPDATA').replace('\\','\\\\') + r'\Programs\Python\Python39\Lib\site-packages')
import clr
clr.AddReference('ProtoGeometry')
from Autodesk.DesignScript.Geometry import *
from collections import Iterable

def iterable(obj):
    return isinstance(obj, Iterable)


# The inputs to this node will be stored as a list in the IN variables.
dataEnteringNode = IN
PathIn = IN[0]
SheetNameIn = IN[1]

# Place your code below this line
import datetime
import openpyxl

path = (PathIn)
#path = (r'C:\Users\pjmk0\Downloads\MK\mQ\BIM_물량집계 자동화 산출기준표_rC(20210607)_mk_de.xlsx')

wb_obj = openpyxl.load_workbook(path, data_only=True)
sheet_obj = wb_obj.get_sheet_by_name(SheetNameIn)

m_row = sheet_obj.max_row
m_col = sheet_obj.max_column

listOut = []



for i in range(1, m_row +1):
    listTemp = []
    for j in range(1, m_col + 1):
        cell_obj = sheet_obj.cell(row=i, column=j)
        listTemp.append(cell_obj.value)
        if len(listTemp) == m_col:
            listOut.append(listTemp)
        


# Assign your output to the OUT variable.
OUT = listOut
#OUT = os.getenv('APPDATA')
# ----------------------------------------
excel_data_정리_전 = Watch(python_script_import_excel_by)

remember_2 = Data.Remember(excel_data_정리_전)

# group: Excel List 분할
excel_data_정리_전_2 = Watch(remember_2)
transpose = List.Transpose(lists=excel_data_정리_전_2)
code_block_3 = CodeBlock { 1; }
# note: List Name 정리
dropItems = List.DropItems(list=transpose@L2, amount=code_block_3)
watch = Watch(dropItems)
code_block_4 = CodeBlock { 0; }
getItemAtIndex = List.GetItemAtIndex(list=watch, index=code_block_4)
space_id = Watch(getItemAtIndex)
code_block_5 = CodeBlock { 1; }
getItemAtIndex_2 = List.GetItemAtIndex(list=watch, index=code_block_5)
space_name = Watch(getItemAtIndex_2)
code_block_6 = CodeBlock { 10; }
getItemAtIndex_3 = List.GetItemAtIndex(list=watch, index=code_block_6)
adjacent_spaces = Watch(getItemAtIndex_3)
code_block_7 = CodeBlock { 3; }
getItemAtIndex_4 = List.GetItemAtIndex(list=watch, index=code_block_7)
department_id = Watch(getItemAtIndex_4)
code_block_8 = CodeBlock { 2; }
getItemAtIndex_5 = List.GetItemAtIndex(list=watch, index=code_block_8)
DEPARTMENT = Watch(getItemAtIndex_5)
code_block_9 = CodeBlock { 5; }
getItemAtIndex_6 = List.GetItemAtIndex(list=watch, index=code_block_9)
WIDTH = Watch(getItemAtIndex_6)
code_block_10 = CodeBlock { 6; }
getItemAtIndex_7 = List.GetItemAtIndex(list=watch, index=code_block_10)
length = Watch(getItemAtIndex_7)
code_block_11 = CodeBlock { 7; }
getItemAtIndex_8 = List.GetItemAtIndex(list=watch, index=code_block_11)
height = Watch(getItemAtIndex_8)
code_block_12 = CodeBlock { 8; }
getItemAtIndex_9 = List.GetItemAtIndex(list=watch, index=code_block_12)
AREA = Watch(getItemAtIndex_9)

code_block_13 = CodeBlock { 11; }
getItemAtIndex_10 = List.GetItemAtIndex(list=watch, index=code_block_13)

# group (continued): Excel List 분할
lev = Watch(getItemAtIndex_10)
code_block_14 = CodeBlock(ExcelDataWithNoHead=watch, SpaceID=space_id, SpaceName=space_name, AdjacentSpaces=adjacent_spaces, DepartmentID=department_id, Department=DEPARTMENT, Level=lev, Width=WIDTH, Length=length, Height=height, Area=AREA)
# ---------- code_block_14.designscript (13 lines) ----------
{
"ExcelDataWithNoHead": _ExcelDataWithNoHead,
"SpaceID": _SpaceID,
"SpaceName": _SpaceName,
"AdjacentSpaces": _AdjacentSpaces,
"DepartmentID": _DepartmentID,
"Department": _Department,
"Level": _Level,
"Width": _Width,
"Length": _Length,
"Height": _Height,
"Area": _Area
};
# ----------------------------------------

code_block_15 = CodeBlock(InputDic=code_block_14) { _InputDic; }
code_block_16 = CodeBlock { "Width"; }
valueAtKey = DesignScript.Builtin.Dictionary.ValueAtKey(dictionary=code_block_15, key=code_block_16)
code_block_17 = CodeBlock { "Length"; }
valueAtKey_2 = DesignScript.Builtin.Dictionary.ValueAtKey(dictionary=code_block_15, key=code_block_17)
code_block_18 = CodeBlock { "Height"; }
valueAtKey_3 = DesignScript.Builtin.Dictionary.ValueAtKey(dictionary=code_block_15, key=code_block_18)
byLengths = Cuboid.ByLengths(width=valueAtKey, length=valueAtKey_2, height=valueAtKey_3)
centroid = Solid.Centroid(solid=byLengths)

# group: 고정부 Seed
seed_고정부_코어 = DoubleSlider(736, range=0..999 step 1)  # graph input

# group: 변동부 Seed
seed_변형부_공간 = DoubleSlider(739, range=0..999 step 1)  # graph input

# group: 회전 Seed
seed_회전용 = DoubleSlider(578, range=0..999 step 1)  # graph input

code_block_19 = CodeBlock(FixedPartSeed=seed_고정부_코어, NonFixedPartSeed=seed_변형부_공간, RotatingSeed=seed_회전용)
# ---------- code_block_19.designscript (6 lines) ----------
{
"FixedPartSeed": _FixedPartSeed,
"NonFixedPartSeed": _NonFixedPartSeed,
"RotatingSeed": _RotatingSeed
//"BoxHeight": _BoxHeight
};
# ----------------------------------------
extendsChildDictionaryFromParent = Custom[ExtendsChildDictionaryFromParent](ParentDic=code_block, ChildDic=code_block_19)  # Extends Child Dictionary From Parent
code_block_20 = CodeBlock { "SpaceID"; }
valueAtKey_4 = DesignScript.Builtin.Dictionary.ValueAtKey(dictionary=code_block_15, key=code_block_20)
code_block_21 = CodeBlock { "SpaceName"; }
valueAtKey_5 = DesignScript.Builtin.Dictionary.ValueAtKey(dictionary=code_block_15, key=code_block_21)
code_block_22 = CodeBlock { "AdjacentSpaces"; }
valueAtKey_6 = DesignScript.Builtin.Dictionary.ValueAtKey(dictionary=code_block_15, key=code_block_22)
code_block_23 = CodeBlock { "DepartmentID"; }
valueAtKey_7 = DesignScript.Builtin.Dictionary.ValueAtKey(dictionary=code_block_15, key=code_block_23)
code_block_24 = CodeBlock { "Department"; }
valueAtKey_8 = DesignScript.Builtin.Dictionary.ValueAtKey(dictionary=code_block_15, key=code_block_24)
code_block_25 = CodeBlock { "Level"; }
valueAtKey_9 = DesignScript.Builtin.Dictionary.ValueAtKey(dictionary=code_block_15, key=code_block_25)
code_block_26 = CodeBlock { "Area"; }
valueAtKey_10 = DesignScript.Builtin.Dictionary.ValueAtKey(dictionary=code_block_15, key=code_block_26)
code_block_27 = CodeBlock(BoxSpaceID=valueAtKey_4, BoxSpaceName=valueAtKey_5, BoxAdjacentSpaces=valueAtKey_6, BoxDepartmentID=valueAtKey_7, BoxDepartment=valueAtKey_8, BoxLevel=valueAtKey_9, BoxWidth=valueAtKey, BoxLength=valueAtKey_2, BoxHeight=valueAtKey_3, BoxArea=valueAtKey_10)
# ---------- code_block_27.designscript (15 lines) ----------
///Box Class Primary
{
"BoxSpaceID": _BoxSpaceID,
"BoxSpaceName": _BoxSpaceName,
"BoxAdjacentSpaces": _BoxAdjacentSpaces,
"BoxDepartmentID": _BoxDepartmentID,
"BoxDepartment": _BoxDepartment,
"BoxLevel": _BoxLevel,
"BoxWidth": _BoxWidth,
"BoxLength": _BoxLength,
"BoxHeight": _BoxHeight,
"BoxArea": _BoxArea
///"BoxGeometry": _BoxGeometry,
///"BoxCenterPoint": _BoxCenterPoint
};
# ----------------------------------------
code_block_28 = CodeBlock(BoxClass_Primary=code_block_27)
# ---------- code_block_28.designscript (3 lines) ----------
{
"BoxClass_Primary": _BoxClass_Primary
};
# ----------------------------------------
extendsChildDictionaryFromParent_2 = Custom[ExtendsChildDictionaryFromParent](ParentDic=extendsChildDictionaryFromParent.dictionary, ChildDic=code_block_28)

# group: Level에 따라 Z 값 Dictionary 추출
code_block_29 = CodeBlock(InputDic=extendsChildDictionaryFromParent_2.dictionary) { _InputDic; }
code_block_30 = CodeBlock { "BoxClass_Primary"; }
valueAtKey_11 = DesignScript.Builtin.Dictionary.ValueAtKey(dictionary=code_block_29, key=code_block_30)
code_block_31 = CodeBlock { "BoxLevel"; }
valueAtKey_12 = DesignScript.Builtin.Dictionary.ValueAtKey(dictionary=valueAtKey_11, key=code_block_31)
lev_2 = Watch(valueAtKey_12)
uniqueItems = List.UniqueItems(list=lev_2)
code_block_32 = CodeBlock { [-6000,0,6000,12000]; }
byKeysValues = DesignScript.Builtin.Dictionary.ByKeysValues(keys=uniqueItems, values=code_block_32)
watch_2 = Watch(byKeysValues)
valueAtKey_13 = DesignScript.Builtin.Dictionary.ValueAtKey(dictionary=watch_2, key=lev_2)
z_값_lev_에서_추출 = Watch(valueAtKey_13)
code_block_33 = CodeBlock(BoxZvalue=z_값_lev_에서_추출)
# ---------- code_block_33.designscript (3 lines) ----------
{
"BoxZvalue": _BoxZvalue
};
# ----------------------------------------
extendsChildDictionaryFromParent_3 = Custom[ExtendsChildDictionaryFromParent](ParentDic=valueAtKey_11, ChildDic=code_block_33)
setValueAtKeys = DesignScript.Builtin.Dictionary.SetValueAtKeys(dictionary=code_block_29, keys=code_block_30, values=extendsChildDictionaryFromParent_3.dictionary)

# group: 룸 BoundingBox 포인트 추출
code_block_34 = CodeBlock(InputDic=setValueAtKeys) { _InputDic; }
code_block_35 = CodeBlock { "RoomBoundary"; }
valueAtKey_14 = DesignScript.Builtin.Dictionary.ValueAtKey(dictionary=code_block_34, key=code_block_35)
byGeometry = BoundingBox.ByGeometry(geom=valueAtKey_14)
minPoint = BoundingBox.MinPoint(boundingBox=byGeometry)
X = Point.X(point=minPoint)
maxPoint = BoundingBox.MaxPoint(boundingBox=byGeometry)
X_2 = Point.X(point=maxPoint)
code_block_36 = CodeBlock { 500; }
code_block_37 = CodeBlock(a=X, b=X_2, x=code_block_36) { a..b..x; }
Y = Point.Y(point=minPoint)
Y_2 = Point.Y(point=maxPoint)
code_block_38 = CodeBlock { 500; }
code_block_39 = CodeBlock(a=Y, b=Y_2, x=code_block_38) { a..b..x; }
byCoordinates = Point.ByCoordinates(x=code_block_37, y=code_block_39, lacing=CrossProduct)
flatten_2 = List.Flatten(list=byCoordinates)
code_block_40 = CodeBlock(GridPointOfBoundingBox=flatten_2)
# ---------- code_block_40.designscript (3 lines) ----------
{
"GridPointOfBoundingBox": _GridPointOfBoundingBox
};
# ----------------------------------------
extendsChildDictionaryFromParent_4 = Custom[ExtendsChildDictionaryFromParent](ParentDic=code_block_34, ChildDic=code_block_40)

# group: Fixed Part 종류별 카운팅 및 Seed Random 값 부여
code_block_41 = CodeBlock(InputDic=extendsChildDictionaryFromParent_4.dictionary) { _InputDic; }
code_block_42 = CodeBlock { "BoxSeed(fixed)"; }
code_block_43 = CodeBlock { "BoxClass_Primary"; }
valueAtKey_15 = DesignScript.Builtin.Dictionary.ValueAtKey(dictionary=code_block_41, key=code_block_43)
components = DesignScript.Builtin.Dictionary.Components(dictionary=valueAtKey_15)
watch_3 = Watch(components.keys)
addItemToEnd = List.AddItemToEnd(item=code_block_42, list=watch_3)
code_block_44 = CodeBlock { "BoxDepartment"; }
valueAtKey_16 = DesignScript.Builtin.Dictionary.ValueAtKey(dictionary=valueAtKey_15, key=code_block_44)
code_block_45 = CodeBlock()
# ---------- code_block_45.designscript (6 lines) ----------
[
"PATHV1",
"PATHV2",
"PATHV3"
];
[];
# ----------------------------------------
contains = String.Contains(str=valueAtKey_16, searchFor=code_block_45.out0@@L1)
boolean = BoolSelector(true)
allIndicesOf = List.AllIndicesOf(list=contains@@L2, item=boolean)
count = List.Count(list=allIndicesOf@L3)
code_block_46 = CodeBlock { 0; }
code_block_47 = CodeBlock { "GridPointOfBoundingBox"; }
valueAtKey_17 = DesignScript.Builtin.Dictionary.ValueAtKey(dictionary=code_block_41, key=code_block_47)
count_2 = List.Count(list=valueAtKey_17)
watch_4 = Watch(count_2)
code_block_48 = CodeBlock { "FixedPartSeed"; }
valueAtKey_18 = DesignScript.Builtin.Dictionary.ValueAtKey(dictionary=code_block_41, key=code_block_48)
randomList = Math.RandomList(amount=count, value1=code_block_46, value2=watch_4, seed=valueAtKey_18)
count_3 = List.Count(list=allIndicesOf@L2)
ofRepeatedItem = List.OfRepeatedItem(item=randomList@L1, amount=count_3@L1)
flatten_3 = List.Flatten(list=ofRepeatedItem)
round = Math.Round(number=flatten_3)
transpose_2 = List.Transpose(lists=components.values)
flatten_4 = List.Flatten(list=allIndicesOf)
list_getitematindex_fixed = List.GetItemAtIndex(list=transpose_2, index=flatten_4)
addItemToEnd_2 = List.AddItemToEnd(item=round@L1, list=list_getitematindex_fixed@L2)
transpose_3 = List.Transpose(lists=addItemToEnd_2)
byKeysValues_2 = DesignScript.Builtin.Dictionary.ByKeysValues(keys=addItemToEnd, values=transpose_3)
code_block_49 = CodeBlock(BoxClass_fixedpart=byKeysValues_2)
# ---------- code_block_49.designscript (3 lines) ----------
{
"BoxClass_fixedpart": _BoxClass_fixedpart
};
# ----------------------------------------
extendsChildDictionaryFromParent_5 = Custom[ExtendsChildDictionaryFromParent](ParentDic=code_block_41, ChildDic=code_block_49)

# group: Fixed Part 형상 배치 by Seed(회전 고려)
code_block_50 = CodeBlock(InputDic=extendsChildDictionaryFromParent_5.dictionary) { _InputDic; }
code_block_51 = CodeBlock { "BoxClass_fixedpart"; }
valueAtKey_19 = DesignScript.Builtin.Dictionary.ValueAtKey(dictionary=code_block_50, key=code_block_51)
code_block_52 = CodeBlock { "BoxZvalue"; }
valueAtKey_20 = DesignScript.Builtin.Dictionary.ValueAtKey(dictionary=valueAtKey_19, key=code_block_52)
uniqueItems_2 = List.UniqueItems(list=valueAtKey_20)
code_block_53 = CodeBlock { "BoxClass_fixedpart"; }
code_block_54 = CodeBlock { "BoxGeometry"; }
components_2 = DesignScript.Builtin.Dictionary.Components(dictionary=valueAtKey_19)
addItemToEnd_3 = List.AddItemToEnd(item=code_block_54, list=components_2.keys)
code_block_55 = CodeBlock { "GridPointOfBoundingBox"; }
valueAtKey_21 = DesignScript.Builtin.Dictionary.ValueAtKey(dictionary=code_block_50, key=code_block_55)
code_block_56 = CodeBlock { "BoxSeed(fixed)"; }
valueAtKey_22 = DesignScript.Builtin.Dictionary.ValueAtKey(dictionary=valueAtKey_19, key=code_block_56)
getItemAtIndex_11 = List.GetItemAtIndex(list=valueAtKey_21, index=valueAtKey_22)
X_3 = Point.X(point=getItemAtIndex_11)
Y_3 = Point.Y(point=getItemAtIndex_11)
firstItem_2 = List.FirstItem(list=valueAtKey_20)
code_block_57 = CodeBlock(i=valueAtKey_20, j=firstItem_2) { i+Math.Abs(j/2); }
byCoordinates_2 = Point.ByCoordinates(x=X_3, y=Y_3, z=code_block_57)
code_block_58 = CodeBlock { "BoxWidth"; }
valueAtKey_23 = DesignScript.Builtin.Dictionary.ValueAtKey(dictionary=valueAtKey_19, key=code_block_58)
code_block_59 = CodeBlock { "BoxLength"; }
valueAtKey_24 = DesignScript.Builtin.Dictionary.ValueAtKey(dictionary=valueAtKey_19, key=code_block_59)
code_block_60 = CodeBlock { "BoxHeight"; }
valueAtKey_25 = DesignScript.Builtin.Dictionary.ValueAtKey(dictionary=valueAtKey_19, key=code_block_60)
byLengths_2 = Cuboid.ByLengths(origin=byCoordinates_2, width=valueAtKey_23, length=valueAtKey_24, height=valueAtKey_25)
centroid_2 = Solid.Centroid(solid=byLengths_2)
ZAxis = Vector.ZAxis()
code_block_61 = CodeBlock { "BoxClass_Primary"; }
valueAtKey_26 = DesignScript.Builtin.Dictionary.ValueAtKey(dictionary=code_block_50, key=code_block_61)
code_block_62 = CodeBlock { "BoxDepartment"; }
valueAtKey_27 = DesignScript.Builtin.Dictionary.ValueAtKey(dictionary=valueAtKey_26, key=code_block_62)
code_block_63 = CodeBlock()  # same code as code_block_45
contains_2 = String.Contains(str=valueAtKey_27, searchFor=code_block_63.out0@@L1)
boolean_2 = BoolSelector(true)
allIndicesOf_2 = List.AllIndicesOf(list=contains_2@@L2, item=boolean_2)
count_4 = List.Count(list=allIndicesOf_2)
code_block_64 = CodeBlock { 0; }
code_block_65 = CodeBlock { 90; }
code_block_66 = CodeBlock { "RotatingSeed"; }
valueAtKey_28 = DesignScript.Builtin.Dictionary.ValueAtKey(dictionary=code_block_50, key=code_block_66)
randomList_2 = Math.RandomList(amount=count_4, value1=code_block_64, value2=code_block_65, seed=valueAtKey_28)
code_block_67 = CodeBlock(i=randomList_2) { i>=45; }
code_block_68 = CodeBlock { 90; 0; }
if_ = If(test=code_block_67, true=code_block_68.out0, false=code_block_68.out1)
count_5 = List.Count(list=allIndicesOf_2@L2)
ofRepeatedItem_2 = List.OfRepeatedItem(item=if_@L1, amount=count_5@L1)
flatten_5 = List.Flatten(list=ofRepeatedItem_2)
rotate = Geometry.Rotate(geometry=byLengths_2, origin=centroid_2, axis=ZAxis, degrees=flatten_5)
addItemToEnd_4 = List.AddItemToEnd(item=rotate, list=components_2.values)
byKeysValues_3 = DesignScript.Builtin.Dictionary.ByKeysValues(keys=addItemToEnd_3, values=addItemToEnd_4)
setValueAtKeys_2 = DesignScript.Builtin.Dictionary.SetValueAtKeys(dictionary=code_block_50, keys=code_block_53, values=byKeysValues_3)

# group: 레벨 별 고정부 비점유 포인트 추출
code_block_69 = CodeBlock(InputDic=setValueAtKeys_2) { _InputDic; }
code_block_70 = CodeBlock { "GridPointOfBoundingBox"; }
valueAtKey_29 = DesignScript.Builtin.Dictionary.ValueAtKey(dictionary=code_block_69, key=code_block_70)
X_4 = Point.X(point=valueAtKey_29)
Y_4 = Point.Y(point=valueAtKey_29)
code_block_71 = CodeBlock { "BoxClass_fixedpart"; }
valueAtKey_30 = DesignScript.Builtin.Dictionary.ValueAtKey(dictionary=code_block_69, key=code_block_71)
code_block_72 = CodeBlock { "BoxZvalue"; }
valueAtKey_31 = DesignScript.Builtin.Dictionary.ValueAtKey(dictionary=valueAtKey_30, key=code_block_72)
uniqueItems_3 = List.UniqueItems(list=valueAtKey_31)
byCoordinates_3 = Point.ByCoordinates(x=X_4, y=Y_4, z=uniqueItems_3@L1)
code_block_73 = CodeBlock { "BoxGeometry"; }
valueAtKey_32 = DesignScript.Builtin.Dictionary.ValueAtKey(dictionary=valueAtKey_30, key=code_block_73)
byUnion = Solid.ByUnion(solids=valueAtKey_32)
doesIntersect = Geometry.DoesIntersect(geometry=byCoordinates_3, other=byUnion)
filterByBoolMask = List.FilterByBoolMask(list=byCoordinates_3@L2, mask=doesIntersect@L2)
watch_5 = Watch(filterByBoolMask.out)
code_block_74 = CodeBlock(RestGridPointByLevel=watch_5)
# ---------- code_block_74.designscript (3 lines) ----------
{
"RestGridPointByLevel": _RestGridPointByLevel
};
# ----------------------------------------
extendsChildDictionaryFromParent_6 = Custom[ExtendsChildDictionaryFromParent](ParentDic=code_block_69, ChildDic=code_block_74)

code_block_75 = CodeBlock(i=extendsChildDictionaryFromParent_6.dictionary) { i; }

# group: Non-Fixed Part 종류별 카운팅
code_block_76 = CodeBlock(InputDic=code_block_75) { _InputDic; }
code_block_77 = CodeBlock { "BoxClass_Primary"; }
valueAtKey_33 = DesignScript.Builtin.Dictionary.ValueAtKey(dictionary=code_block_76, key=code_block_77)
components_3 = DesignScript.Builtin.Dictionary.Components(dictionary=valueAtKey_33)
transpose_4 = List.Transpose(lists=components_3.values)
code_block_78 = CodeBlock { "BoxSpaceID"; }
valueAtKey_34 = DesignScript.Builtin.Dictionary.ValueAtKey(dictionary=valueAtKey_33, key=code_block_78)
code_block_79 = CodeBlock { "BoxClass_fixedpart"; }
valueAtKey_35 = DesignScript.Builtin.Dictionary.ValueAtKey(dictionary=code_block_76, key=code_block_79)
code_block_80 = CodeBlock { "BoxSpaceID"; }
valueAtKey_36 = DesignScript.Builtin.Dictionary.ValueAtKey(dictionary=valueAtKey_35, key=code_block_80)
setDifference = List.SetDifference(list1=valueAtKey_34, list2=valueAtKey_36)
getItemAtIndex_12 = List.GetItemAtIndex(list=transpose_4, index=setDifference)
transpose_5 = List.Transpose(lists=getItemAtIndex_12)
byKeysValues_4 = DesignScript.Builtin.Dictionary.ByKeysValues(keys=components_3.keys, values=transpose_5)
code_block_81 = CodeBlock(BoxClass_nonfixedpart=byKeysValues_4)
# ---------- code_block_81.designscript (3 lines) ----------
{
"BoxClass_nonfixedpart": _BoxClass_nonfixedpart
};
# ----------------------------------------
extendsChildDictionaryFromParent_7 = Custom[ExtendsChildDictionaryFromParent](ParentDic=code_block_76, ChildDic=code_block_81)

# group: Non-Fixed Part 레벨 별 Seed Random 값 부여
code_block_82 = CodeBlock(InputDic=extendsChildDictionaryFromParent_7.dictionary) { _InputDic; }
code_block_83 = CodeBlock { "BoxClass_nonfixedpart"; }
code_block_84 = CodeBlock { "BoxSeed(nonfixed)"; }
code_block_85 = CodeBlock { "BoxClass_nonfixedpart"; }
valueAtKey_37 = DesignScript.Builtin.Dictionary.ValueAtKey(dictionary=code_block_82, key=code_block_85)
components_4 = DesignScript.Builtin.Dictionary.Components(dictionary=valueAtKey_37)
addItemToEnd_5 = List.AddItemToEnd(item=code_block_84, list=components_4.keys)
code_block_86 = CodeBlock { "BoxClass_nonfixedpart"; }
valueAtKey_38 = DesignScript.Builtin.Dictionary.ValueAtKey(dictionary=code_block_82, key=code_block_86)
code_block_87 = CodeBlock { "BoxLevel"; }
valueAtKey_39 = DesignScript.Builtin.Dictionary.ValueAtKey(dictionary=valueAtKey_38, key=code_block_87)
uniqueItems_4 = List.UniqueItems(list=valueAtKey_39)
allIndicesOf_3 = List.AllIndicesOf(list=valueAtKey_39, item=uniqueItems_4)
count_6 = List.Count(list=allIndicesOf_3@L2)
code_block_88 = CodeBlock { 0; }
code_block_89 = CodeBlock { "RestGridPointByLevel"; }
valueAtKey_40 = DesignScript.Builtin.Dictionary.ValueAtKey(dictionary=code_block_82, key=code_block_89)
count_7 = List.Count(list=valueAtKey_40@L2)
count_8 = List.Count(list=allIndicesOf_3@L3)
code_block_90 = CodeBlock { 0; 999; }
code_block_91 = CodeBlock { "NonFixedPartSeed"; }
valueAtKey_41 = DesignScript.Builtin.Dictionary.ValueAtKey(dictionary=code_block_82, key=code_block_91)
randomList_3 = Math.RandomList(amount=count_8, value1=code_block_90.out0, value2=code_block_90.out1, seed=valueAtKey_41)
flatten_6 = List.Flatten(list=randomList_3)
randomList_4 = Math.RandomList(amount=count_6, value1=code_block_88, value2=count_7, seed=flatten_6)
flatten_7 = List.Flatten(list=randomList_4)
round_2 = Math.Round(number=flatten_7)
components_5 = DesignScript.Builtin.Dictionary.Components(dictionary=valueAtKey_38)
transpose_6 = List.Transpose(lists=components_5.values)
getItemAtIndex_13 = List.GetItemAtIndex(list=transpose_6, index=allIndicesOf_3)
flatten_8 = List.Flatten(list=getItemAtIndex_13@L2)
addItemToEnd_6 = List.AddItemToEnd(item=round_2@L1, list=flatten_8@L2)
transpose_7 = List.Transpose(lists=addItemToEnd_6)
byKeysValues_5 = DesignScript.Builtin.Dictionary.ByKeysValues(keys=addItemToEnd_5, values=transpose_7)
setValueAtKeys_3 = DesignScript.Builtin.Dictionary.SetValueAtKeys(dictionary=code_block_82, keys=code_block_83, values=byKeysValues_5)

# group: Non-Fixed Part 형상 배치 by Seed(회전 고려)
code_block_92 = CodeBlock(InputDic=setValueAtKeys_3) { _InputDic; }
code_block_93 = CodeBlock { "BoxClass_fixedpart"; }
code_block_94 = CodeBlock { "BoxGeometry"; }
code_block_95 = CodeBlock { "BoxClass_nonfixedpart"; }
valueAtKey_42 = DesignScript.Builtin.Dictionary.ValueAtKey(dictionary=code_block_92, key=code_block_95)
components_6 = DesignScript.Builtin.Dictionary.Components(dictionary=valueAtKey_42)
addItemToEnd_7 = List.AddItemToEnd(item=code_block_94, list=components_6.keys)
code_block_96 = CodeBlock { "RestGridPointByLevel"; }
valueAtKey_43 = DesignScript.Builtin.Dictionary.ValueAtKey(dictionary=code_block_92, key=code_block_96)
code_block_97 = CodeBlock { "BoxSeed(nonfixed)"; }
valueAtKey_44 = DesignScript.Builtin.Dictionary.ValueAtKey(dictionary=valueAtKey_42, key=code_block_97)
code_block_98 = CodeBlock { "BoxLevel"; }
valueAtKey_45 = DesignScript.Builtin.Dictionary.ValueAtKey(dictionary=valueAtKey_42, key=code_block_98)
uniqueItems_5 = List.UniqueItems(list=valueAtKey_45)
allIndicesOf_4 = List.AllIndicesOf(list=valueAtKey_45, item=uniqueItems_5)
count_9 = List.Count(list=allIndicesOf_4@L2)
chop = List.Chop(list=valueAtKey_44, lengths=count_9)
getItemAtIndex_14 = List.GetItemAtIndex(list=valueAtKey_43@L2, index=chop@L2)
X_5 = Point.X(point=getItemAtIndex_14)
flatten_9 = List.Flatten(list=X_5)
Y_5 = Point.Y(point=getItemAtIndex_14)
flatten_10 = List.Flatten(list=Y_5)
code_block_99 = CodeBlock { "BoxZvalue"; }
valueAtKey_46 = DesignScript.Builtin.Dictionary.ValueAtKey(dictionary=valueAtKey_42, key=code_block_99)
firstItem_3 = List.FirstItem(list=valueAtKey_46)
code_block_100 = CodeBlock(i=valueAtKey_46, j=firstItem_3) { i+Math.Abs(j/2); }
byCoordinates_4 = Point.ByCoordinates(x=flatten_9, y=flatten_10, z=code_block_100)
flatten_11 = List.Flatten(list=byCoordinates_4)
code_block_101 = CodeBlock { "BoxWidth"; }
valueAtKey_47 = DesignScript.Builtin.Dictionary.ValueAtKey(dictionary=valueAtKey_42, key=code_block_101)
code_block_102 = CodeBlock { "BoxLength"; }
valueAtKey_48 = DesignScript.Builtin.Dictionary.ValueAtKey(dictionary=valueAtKey_42, key=code_block_102)
code_block_103 = CodeBlock { "BoxHeight"; }
valueAtKey_49 = DesignScript.Builtin.Dictionary.ValueAtKey(dictionary=valueAtKey_42, key=code_block_103)
byLengths_3 = Cuboid.ByLengths(origin=flatten_11, width=valueAtKey_47, length=valueAtKey_48, height=valueAtKey_49)
centroid_3 = Solid.Centroid(solid=byLengths_3)
ZAxis_2 = Vector.ZAxis()
code_block_104 = CodeBlock { "BoxSpaceName"; }
valueAtKey_50 = DesignScript.Builtin.Dictionary.ValueAtKey(dictionary=valueAtKey_42, key=code_block_104)
count_10 = List.Count(list=valueAtKey_50)
code_block_105 = CodeBlock { 0; }
code_block_106 = CodeBlock { 90; }
code_block_107 = CodeBlock { "RotatingSeed"; }
valueAtKey_51 = DesignScript.Builtin.Dictionary.ValueAtKey(dictionary=code_block_92, key=code_block_107)
randomList_5 = Math.RandomList(amount=count_10, value1=code_block_105, value2=code_block_106, seed=valueAtKey_51)
code_block_108 = CodeBlock(i=randomList_5) { i>=45; }
code_block_109 = CodeBlock { 90; 0; }
if_2 = If(test=code_block_108, true=code_block_109.out0, false=code_block_109.out1)
flatten_12 = List.Flatten(list=if_2)
rotate_2 = Geometry.Rotate(geometry=byLengths_3, origin=centroid_3, axis=ZAxis_2, degrees=flatten_12)
addItemToEnd_8 = List.AddItemToEnd(item=rotate_2, list=components_6.values)
byKeysValues_6 = DesignScript.Builtin.Dictionary.ByKeysValues(keys=addItemToEnd_7, values=addItemToEnd_8)
setValueAtKeys_4 = DesignScript.Builtin.Dictionary.SetValueAtKeys(dictionary=code_block_92, keys=code_block_93, values=byKeysValues_6)

color_palette = ColorPalette({R: 255, G: 20, B: 147, A: 255})
byGeometryColor = Modifiers.GeometryColor.ByGeometryColor(geometry=rotate, color=color_palette)
color_palette_2 = ColorPalette({R: 0, G: 255, B: 255, A: 120})
byGeometryColor_2 = Modifiers.GeometryColor.ByGeometryColor(geometry=rotate_2, color=color_palette_2)
