# Dynamo graph ClusterGravity test 001mk.dyn (Dynamo 2.10.1.3976)

code_block = CodeBlock { 100; }
byLengths = Cuboid.ByLengths(width=code_block, length=code_block, height=code_block)
centroid = Solid.Centroid(solid=byLengths)
code_block_2 = CodeBlock { 100; 150; }
byCoordinates = Point.ByCoordinates(x=code_block_2.out0, y=code_block_2.out1)
code_block_3 = CodeBlock { 100; 150; }
byLengths_2 = Cuboid.ByLengths(origin=byCoordinates, width=code_block_3.out0, length=code_block_3.out1, height=code_block_3.out0)
centroid_2 = Solid.Centroid(solid=byLengths_2)
code_block_4 = CodeBlock { 100; 350; 200; }
byCoordinates_2 = Point.ByCoordinates(x=code_block_4.out1, y=code_block_4.out2)
code_block_5 = CodeBlock { 100; 150; 200; }
byLengths_3 = Cuboid.ByLengths(origin=byCoordinates_2, width=code_block_5.out2, length=code_block_5.out1, height=code_block_5.out0)
centroid_3 = Solid.Centroid(solid=byLengths_3)
join = List.Join(list0=centroid, list1=centroid_2, list2=centroid_3)
byPoints = Polygon.ByPoints(points=join)
explode = Geometry.Explode(geometry=byPoints)
length = Curve.Length(curve=explode)
join_2 = List.Join(list0=byLengths, list1=byLengths_2, list2=byLengths_3)
intersect = Geometry.Intersect(geometry=explode, other=join_2, lacing=CrossProduct)
code_block_6 = CodeBlock(BoxGeometry=join_2, BoxCenterPoint=join)
# ---------- code_block_6.designscript (4 lines) ----------
{
"BoxGeometry": _BoxGeometry,
"BoxCenterPoint": _BoxCenterPoint
};
# ----------------------------------------

# group: Effective Length Calculate
code_block_7 = CodeBlock { "BoxCenterPoint"; }
valueAtKey = DesignScript.Builtin.Dictionary.ValueAtKey(dictionary=code_block_6, key=code_block_7)
code_block_8 = CodeBlock { 2; }
combinations = List.Combinations(list=valueAtKey, length=code_block_8)
code_block_9 = CodeBlock { 0; }
getItemAtIndex = List.GetItemAtIndex(list=combinations@L2, index=code_block_9)
code_block_10 = CodeBlock { 1; }
getItemAtIndex_2 = List.GetItemAtIndex(list=combinations@L2, index=code_block_10)
byStartPointEndPoint = Line.ByStartPointEndPoint(startPoint=getItemAtIndex, endPoint=getItemAtIndex_2)
code_block_11 = CodeBlock { "BoxGeometry"; }
valueAtKey_2 = DesignScript.Builtin.Dictionary.ValueAtKey(dictionary=code_block_6, key=code_block_11)
code_block_12 = CodeBlock { 2; }
combinations_2 = List.Combinations(list=valueAtKey_2, length=code_block_12)
byUnion = Solid.ByUnion(solids=combinations_2@L2)
intersect_2 = Geometry.Intersect(geometry=byStartPointEndPoint@L1, other=byUnion@L1, lacing=Shortest)

center = Polygon.Center(polygon=byPoints)
byTwoPoints = Vector.ByTwoPoints(start=valueAtKey, end=center)

# group: Killing Point
code_block_13 = CodeBlock()
# ---------- code_block_13.designscript (5 lines) ----------
[
0.735,
0.2,
0.45
];
# ----------------------------------------
code_block_14 = CodeBlock()
# ---------- code_block_14.designscript (5 lines) ----------
[
0.07,
0.5,
0.8
];
# ----------------------------------------
scale = Vector.Scale(vector=byTwoPoints, xScaleFactor=code_block_13, yScaleFactor=code_block_14)
translate = Geometry.Translate(geometry=valueAtKey_2, direction=scale)

color_palette = ColorPalette({R: 124, G: 252, B: 0, A: 105})
byGeometryColor = Modifiers.GeometryColor.ByGeometryColor(geometry=translate, color=color_palette)
byStartPointEndPoint_2 = Line.ByStartPointEndPoint()  # unwired: startPoint, endPoint
