# Dynamo graph ClusterGravity test 002mk.dyn (Dynamo 2.10.1.3976)

# group: Box 생성부
code_block = CodeBlock { 100; }
byLengths = Cuboid.ByLengths(width=code_block, length=code_block, height=code_block)
code_block_2 = CodeBlock { 100; 150; }
byCoordinates = Point.ByCoordinates(x=code_block_2.out0, y=code_block_2.out1)
code_block_3 = CodeBlock { 100; 150; }
byLengths_2 = Cuboid.ByLengths(origin=byCoordinates, width=code_block_3.out0, length=code_block_3.out1, height=code_block_3.out0)
code_block_4 = CodeBlock { 100; 350; 200; }
byCoordinates_2 = Point.ByCoordinates(x=code_block_4.out1, y=code_block_4.out2)
code_block_5 = CodeBlock { 100; 150; 200; }
byLengths_3 = Cuboid.ByLengths(origin=byCoordinates_2, width=code_block_5.out2, length=code_block_5.out1, height=code_block_5.out0)
code_block_6 = CodeBlock { 350; 450; 500; }
byCoordinates_3 = Point.ByCoordinates(x=code_block_6.out1, y=code_block_6.out2)
code_block_7 = CodeBlock { 100; 250; 300; }
byLengths_4 = Cuboid.ByLengths(origin=byCoordinates_3, width=code_block_7.out2, length=code_block_7.out1, height=code_block_7.out0)

# group: Gathering Seed
gathering_seed = DoubleSlider(1315, range=0..2000 step 1)  # graph input

# group: Solid 중점 추출 및 Data Pouch 형성
join = List.Join(list0=byLengths, list1=byLengths_2, list2=byLengths_3, list3=byLengths_4)
centroid = Solid.Centroid(solid=byLengths)
centroid_2 = Solid.Centroid(solid=byLengths_2)
centroid_3 = Solid.Centroid(solid=byLengths_3)
centroid_4 = Solid.Centroid(solid=byLengths_4)
join_2 = List.Join(list0=centroid, list1=centroid_2, list2=centroid_3, list3=centroid_4)
code_block_8 = CodeBlock(BoxGeometry=join, BoxCenterPoint=join_2, GatheringSeed=gathering_seed)
# ---------- code_block_8.designscript (5 lines) ----------
{
"BoxGeometry": _BoxGeometry,
"BoxCenterPoint": _BoxCenterPoint,
"GatheringSeed": _GatheringSeed
};
# ----------------------------------------

# group: 각 센터 중점에서 Cluster 중점으로의 벡터 형성
code_block_9 = CodeBlock(InputDic=code_block_8) { _InputDic; }
code_block_10 = CodeBlock { "BoxCenterPoint"; }
valueAtKey = DesignScript.Builtin.Dictionary.ValueAtKey(dictionary=code_block_9, key=code_block_10)
python_script = Python(IN[0]=valueAtKey)  # IronPython2
# ---------- python_script.python (55 lines) ----------
import clr
clr.AddReference('ProtoGeometry')
from Autodesk.DesignScript.Geometry import *

def ToVals(pt):
	return [pt.X,pt.Y,pt.Z]

def ToPts(ptVals):
	return Point.ByCoordinates(ptVals[0],ptVals[1],ptVals[2])

def CreateOutline(pts):
	crvs = []
	i = 0
	while i < len(pts):
		if i == len(pts)-1:
			crvs.append(Line.ByStartPointEndPoint(pts[i],pts[0]))
		else:
			crvs.append(Line.ByStartPointEndPoint(pts[i],pts[i+1]))
		i = i+1
	return PolyCurve.ByJoinedCurves(crvs)

'''
Taken from Thomas Switzers awesome GitHub repo and modified to suit Dynamo Context
https://gist.github.com/arthur-e/5cf52962341310f438e96c1f3c3398b8
I take zero credit for this work other than porting it across.
'''
def convex_hull_graham(points):
	'''
	Returns points on convex hull in CCW order according to Graham's scan algorithm. 
	By Tom Switzer <thomas.switzer@gmail.com>.
	'''
	TURN_LEFT, TURN_RIGHT, TURN_NONE = (1, -1, 0)

	def cmp(a, b):
		return (a > b) - (a < b)
	
	def turn(p, q, r):
		return cmp((q[0] - p[0])*(r[1] - p[1]) - (r[0] - p[0])*(q[1] - p[1]), 0)
	
	def _keep_left(hull, r):
		while len(hull) > 1 and turn(hull[-2], hull[-1], r) != TURN_LEFT:
			hull.pop()
		if not len(hull) or hull[-1] != r:
			hull.append(r)
		return hull

	points = [ToVals(p) for p in points]	
	points = sorted(points)
	l = reduce(_keep_left, points, [])
	u = reduce(_keep_left, reversed(points), [])
	points = l.extend(u[i] for i in range(1, len(u) - 1)) or l
	points = [ToPts(p) for p in points]
	return CreateOutline(points)

OUT = convex_hull_graham(IN[0])
# ----------------------------------------
byPatch = Surface.ByPatch(closedCurve=python_script)
thicken = Surface.Thicken(surface=byPatch)
centroid_5 = Solid.Centroid(solid=thicken)
byTwoPoints = Vector.ByTwoPoints(start=valueAtKey, end=centroid_5)
code_block_11 = CodeBlock(VectorToCenter=byTwoPoints)
# ---------- code_block_11.designscript (3 lines) ----------
{
"VectorToCenter": _VectorToCenter
};
# ----------------------------------------
extendsChildDictionaryFromParent = Custom[ExtendsChildDictionaryFromParent](ParentDic=code_block_9, ChildDic=code_block_11)  # Extends Child Dictionary From Parent

# group: Cluster Gathering
code_block_12 = CodeBlock(InputDic=extendsChildDictionaryFromParent.dictionary) { _InputDic; }
code_block_13 = CodeBlock { "BoxGeometry"; }
valueAtKey_2 = DesignScript.Builtin.Dictionary.ValueAtKey(dictionary=code_block_12, key=code_block_13)
code_block_14 = CodeBlock { "VectorToCenter"; }
valueAtKey_3 = DesignScript.Builtin.Dictionary.ValueAtKey(dictionary=code_block_12, key=code_block_14)
count = List.Count(list=valueAtKey_3)
code_block_15 = CodeBlock { 2; }
ofRepeatedItem = List.OfRepeatedItem(item=count, amount=code_block_15)
code_block_16 = CodeBlock { 0; 1; }
code_block_17 = CodeBlock { 2; }
code_block_18 = CodeBlock { 0; 2000; }
code_block_19 = CodeBlock { "GatheringSeed"; }
valueAtKey_4 = DesignScript.Builtin.Dictionary.ValueAtKey(dictionary=code_block_12, key=code_block_19)
randomList = Math.RandomList(amount=code_block_17, value1=code_block_18.out0, value2=code_block_18.out1, seed=valueAtKey_4)
randomList_2 = Math.RandomList(amount=ofRepeatedItem, value1=code_block_16.out0, value2=code_block_16.out1, seed=randomList)
code_block_20 = CodeBlock { 0; }
getItemAtIndex = List.GetItemAtIndex(list=randomList_2, index=code_block_20)
code_block_21 = CodeBlock { 1; }
getItemAtIndex_2 = List.GetItemAtIndex(list=randomList_2, index=code_block_21)
scale = Vector.Scale(vector=valueAtKey_3, xScaleFactor=getItemAtIndex, yScaleFactor=getItemAtIndex_2)
translate = Geometry.Translate(geometry=valueAtKey_2, direction=scale)
code_block_22 = CodeBlock(GatheredBoxGeometry=translate)
# ---------- code_block_22.designscript (3 lines) ----------
{
"GatheredBoxGeometry": _GatheredBoxGeometry
};
# ----------------------------------------
extendsChildDictionaryFromParent_2 = Custom[ExtendsChildDictionaryFromParent](ParentDic=code_block_12, ChildDic=code_block_22)

# group: Gathered CenterPoint 추출
code_block_23 = CodeBlock(InputDic=extendsChildDictionaryFromParent_2.dictionary) { _InputDic; }
code_block_24 = CodeBlock { "GatheredBoxGeometry"; }
valueAtKey_5 = DesignScript.Builtin.Dictionary.ValueAtKey(dictionary=code_block_23, key=code_block_24)
centroid_6 = Solid.Centroid(solid=valueAtKey_5)
code_block_25 = CodeBlock(GatheredBoxCenterPoint=centroid_6)
# ---------- code_block_25.designscript (3 lines) ----------
{
"GatheredBoxCenterPoint": _GatheredBoxCenterPoint
};
# ----------------------------------------
extendsChildDictionaryFromParent_3 = Custom[ExtendsChildDictionaryFromParent](ParentDic=code_block_23, ChildDic=code_block_25)

# group: GathereBoxCenterPoint 와 GatheredBoxGeometry 추출 및 데이터 결합
code_block_26 = CodeBlock(InputDic=extendsChildDictionaryFromParent_3.dictionary) { _InputDic; }
code_block_27 = CodeBlock { "GatheredBoxCenterPoint"; }
valueAtKey_6 = DesignScript.Builtin.Dictionary.ValueAtKey(dictionary=code_block_26, key=code_block_27)
code_block_28 = CodeBlock { "GatheredBoxGeometry"; }
valueAtKey_7 = DesignScript.Builtin.Dictionary.ValueAtKey(dictionary=code_block_26, key=code_block_28)
list_create = List.Create(item0=valueAtKey_6, item1=valueAtKey_7)
transpose = List.Transpose(lists=list_create)
code_block_29 = CodeBlock(GatheredDataTranspos=transpose)
# ---------- code_block_29.designscript (3 lines) ----------
{
"GatheredDataTransposeDic": _GatheredDataTransposeDic
};
# ----------------------------------------
extendsChildDictionaryFromParent_4 = Custom[ExtendsChildDictionaryFromParent](ParentDic=code_block_26, ChildDic=code_block_29)

# group: Cluster 구성 중 면적 상위 1,2 위 선택
code_block_30 = CodeBlock(InputDic=extendsChildDictionaryFromParent_4.dictionary) { _InputDic; }
code_block_31 = CodeBlock { "GatheredBoxGeometry"; }
valueAtKey_8 = DesignScript.Builtin.Dictionary.ValueAtKey(dictionary=code_block_30, key=code_block_31)
explode = Geometry.Explode(geometry=valueAtKey_8)
firstItem = List.FirstItem(list=explode@L2)
area = Surface.Area(surface=firstItem)
maximumItem = List.MaximumItem(list=area)
allIndicesOf = List.AllIndicesOf(list=area, item=maximumItem)
removeItemAtIndex = List.RemoveItemAtIndex(list=area, indices=allIndicesOf)
maximumItem_2 = List.MaximumItem(list=removeItemAtIndex)
allIndicesOf_2 = List.AllIndicesOf(list=area, item=maximumItem_2)
join_3 = List.Join(list0=allIndicesOf, list1=allIndicesOf_2)
code_block_32 = CodeBlock(BoxUpperSurface=firstItem, BoxAreaTop2IndexOfCl=join_3)
# ---------- code_block_32.designscript (4 lines) ----------
{
"BoxUpperSurface": _BoxUpperSurface,
"BoxAreaTop2IndexOfCluster": _BoxAreaTop2IndexOfCluster
};
# ----------------------------------------
extendsChildDictionaryFromParent_5 = Custom[ExtendsChildDictionaryFromParent](ParentDic=code_block_30, ChildDic=code_block_32)

# group: Box Alignment(우상단 정렬 기준)
code_block_33 = CodeBlock(InputDic=extendsChildDictionaryFromParent_5.dictionary) { _InputDic; }
code_block_34 = CodeBlock { "GatheredBoxGeometry"; }
valueAtKey_9 = DesignScript.Builtin.Dictionary.ValueAtKey(dictionary=code_block_33, key=code_block_34)
code_block_35 = CodeBlock { "BoxAreaTop2IndexOfCluster"; }
valueAtKey_10 = DesignScript.Builtin.Dictionary.ValueAtKey(dictionary=code_block_33, key=code_block_35)
lastItem = List.LastItem(list=valueAtKey_10)
# note: 좌하단 정렬 기준도 추가하고 if와 랜덤 시드 부여
code_block_36 = CodeBlock { "BoxUpperSurface"; }
valueAtKey_11 = DesignScript.Builtin.Dictionary.ValueAtKey(dictionary=code_block_33, key=code_block_36)
code_block_37 = CodeBlock { 1; }
pointAtParameter = Surface.PointAtParameter(surface=valueAtKey_11, u=code_block_37, v=code_block_37)
getItemAtIndex_3 = List.GetItemAtIndex(list=pointAtParameter, index=valueAtKey_10)
X = Point.X(point=getItemAtIndex_3)
x_difference = CodeBlock(i=X) { i[0]-i[1]; }
Y = Point.Y(point=getItemAtIndex_3)
y_difference = CodeBlock(i=Y) { i[0]-i[1]; }
code_block_38 = CodeBlock(a=x_difference, b=y_difference) { Math.Abs(a)<Math.Abs(b); }
getItemAtIndex_4 = List.GetItemAtIndex(list=valueAtKey_9, index=lastItem)
translate_2 = Geometry.Translate(geometry=getItemAtIndex_4, xTranslation=x_difference)
translate_3 = Geometry.Translate(geometry=getItemAtIndex_4, yTranslation=y_difference)
if_ = If(test=code_block_38, true=translate_2, false=translate_3)
replaceItemAtIndex = List.ReplaceItemAtIndex(list=valueAtKey_9, index=lastItem, item=if_)
centroid_7 = Solid.Centroid(solid=replaceItemAtIndex)
code_block_39 = CodeBlock(AlignedBoxGeometry=replaceItemAtIndex, AlignedBoxCenterPoint=centroid_7)
# ---------- code_block_39.designscript (4 lines) ----------
{
"AlignedBoxGeometry": _AlignedBoxGeometry,
"AlignedBoxCenterPoint": _AlignedBoxCenterPoint
};
# ----------------------------------------
extendsChildDictionaryFromParent_6 = Custom[ExtendsChildDictionaryFromParent](ParentDic=code_block_33, ChildDic=code_block_39)

color_palette = ColorPalette({R: 124, G: 252, B: 0, A: 105})
byGeometryColor = Modifiers.GeometryColor.ByGeometryColor(geometry=replaceItemAtIndex, color=color_palette)

# group: AlignedBoxCenterPoint 와 AlignedBoxGeometry 추출 및 데이터 결합
code_block_40 = CodeBlock(InputDic=extendsChildDictionaryFromParent_6.dictionary) { _InputDic; }
code_block_41 = CodeBlock { "AlignedBoxCenterPoint"; }
valueAtKey_12 = DesignScript.Builtin.Dictionary.ValueAtKey(dictionary=code_block_40, key=code_block_41)
code_block_42 = CodeBlock { "AlignedBoxGeometry"; }
valueAtKey_13 = DesignScript.Builtin.Dictionary.ValueAtKey(dictionary=code_block_40, key=code_block_42)
list_create_2 = List.Create(item0=valueAtKey_12, item1=valueAtKey_13)
transpose_2 = List.Transpose(lists=list_create_2)
code_block_43 = CodeBlock(AlignedDataTransposeDic=transpose_2)
# ---------- code_block_43.designscript (3 lines) ----------
{
"AlignedDataTransposeDic": _AlignedDataTransposeDic
};
# ----------------------------------------
extendsChildDictionaryFromParent_7 = Custom[ExtendsChildDictionaryFromParent](ParentDic=code_block_40, ChildDic=code_block_43)

# group: Effective Combination 형성
code_block_44 = CodeBlock(InputDic=extendsChildDictionaryFromParent_7.dictionary) { _InputDic; }
code_block_45 = CodeBlock { "AlignedDataTransposeDic"; }
valueAtKey_14 = DesignScript.Builtin.Dictionary.ValueAtKey(dictionary=code_block_44, key=code_block_45)
code_block_46 = CodeBlock { 2; }
combinations = List.Combinations(list=valueAtKey_14, length=code_block_46)
transpose_3 = List.Transpose(lists=combinations@L3)
flatten = List.Flatten(list=transpose_3@L3)
code_block_47 = CodeBlock(EffectiveCombination=flatten)
# ---------- code_block_47.designscript (3 lines) ----------
{
"EffectiveCombinationList": _EffectiveCombinationList
};
# ----------------------------------------
extendsChildDictionaryFromParent_8 = Custom[ExtendsChildDictionaryFromParent](ParentDic=code_block_44, ChildDic=code_block_47)

# group: Effective 전처리: Point to Line
code_block_48 = CodeBlock(InputDic=extendsChildDictionaryFromParent_8.dictionary) { _InputDic; }
code_block_49 = CodeBlock { "EffectiveCombinationList"; }
valueAtKey_15 = DesignScript.Builtin.Dictionary.ValueAtKey(dictionary=code_block_48, key=code_block_49)
code_block_50 = CodeBlock { [0,1]; }
getItemAtIndex_5 = List.GetItemAtIndex(list=valueAtKey_15@L2, index=code_block_50)
code_block_51 = CodeBlock { 0; }
getItemAtIndex_6 = List.GetItemAtIndex(list=getItemAtIndex_5@L2, index=code_block_51)
code_block_52 = CodeBlock { 1; }
getItemAtIndex_7 = List.GetItemAtIndex(list=getItemAtIndex_5@L2, index=code_block_52)
byStartPointEndPoint = Line.ByStartPointEndPoint(startPoint=getItemAtIndex_6, endPoint=getItemAtIndex_7)
code_block_53 = CodeBlock(EffectiveCombination=byStartPointEndPoint)
# ---------- code_block_53.designscript (3 lines) ----------
{
"EffectiveCombinationLine": _EffectiveCombinationLine
};
# ----------------------------------------
extendsChildDictionaryFromParent_9 = Custom[ExtendsChildDictionaryFromParent](ParentDic=code_block_48, ChildDic=code_block_53)

# group: Effective 전처리: Solid to Combination Solid
code_block_54 = CodeBlock(InputDic=extendsChildDictionaryFromParent_9.dictionary) { _InputDic; }
code_block_55 = CodeBlock { "EffectiveCombinationList"; }
valueAtKey_16 = DesignScript.Builtin.Dictionary.ValueAtKey(dictionary=code_block_54, key=code_block_55)
code_block_56 = CodeBlock { [2,3]; }
getItemAtIndex_8 = List.GetItemAtIndex(list=valueAtKey_16@L2, index=code_block_56)
byUnion = Solid.ByUnion(solids=getItemAtIndex_8@L2)
code_block_57 = CodeBlock(EffectiveCombination=byUnion)
# ---------- code_block_57.designscript (3 lines) ----------
{
"EffectiveCombinationSolid": _EffectiveCombinationSolid
};
# ----------------------------------------
extendsChildDictionaryFromParent_10 = Custom[ExtendsChildDictionaryFromParent](ParentDic=code_block_54, ChildDic=code_block_57)

# group: Effective Line 추출 및 Effective Length 편차 총합
code_block_58 = CodeBlock(InputDic=extendsChildDictionaryFromParent_10.dictionary) { _InputDic; }
code_block_59 = CodeBlock { "EffectiveCombinationLine"; }
valueAtKey_17 = DesignScript.Builtin.Dictionary.ValueAtKey(dictionary=code_block_58, key=code_block_59)
length = Curve.Length(curve=valueAtKey_17)
code_block_60 = CodeBlock { "EffectiveCombinationSolid"; }
valueAtKey_18 = DesignScript.Builtin.Dictionary.ValueAtKey(dictionary=code_block_58, key=code_block_60)
intersect = Geometry.Intersect(geometry=valueAtKey_17@L1, other=valueAtKey_18@L1)
length_2 = Curve.Length(curve=intersect)
sum = Math.Sum(values=length_2)
sub = length - sum
effective_length_편차_총합 = Math.Sum(values=sub)  # graph output

intersect_2 = Geometry.Intersect(geometry=valueAtKey_18, other=valueAtKey_18, lacing=CrossProduct)
flatten_2 = List.Flatten(list=intersect_2)
volume = Solid.Volume(solid=flatten_2)
박스_겹침_체적 = Math.Sum(values=volume)  # graph output
code_block_61 = CodeBlock { "GatheredBoxGeometry"; }
valueAtKey_19 = DesignScript.Builtin.Dictionary.ValueAtKey(dictionary=code_block_58, key=code_block_61)
explode_2 = Geometry.Explode(geometry=valueAtKey_19)
firstItem_2 = List.FirstItem(list=explode_2@L2)
perimeterCurves = Surface.PerimeterCurves(surface=firstItem_2)
startPoint = Curve.StartPoint(curve=perimeterCurves)
X_2 = Point.X(point=startPoint)
flatten_3 = List.Flatten(list=X_2)
uniqueItems = List.UniqueItems(list=flatten_3)
x축_다양성 = List.Count(list=uniqueItems)  # graph output
Y_2 = Point.Y(point=startPoint)
flatten_4 = List.Flatten(list=Y_2)
uniqueItems_2 = List.UniqueItems(list=flatten_4)
y축_다양성 = List.Count(list=uniqueItems_2)  # graph output
