# Dynamo graph ClusterGravity test 004mk.dyn (Dynamo 2.10.1.3976)

code_block = CodeBlock { 0..800..40; }
byCoordinates = Point.ByCoordinates(x=code_block, y=code_block, lacing=CrossProduct)
flatten = List.Flatten(list=byCoordinates)
code_block_2 = CodeBlock { 4; }
code_block_3 = CodeBlock { 0; }
count = List.Count(list=flatten)
number_slider = DoubleSlider(758, range=0..999 step 1)
randomList = Math.RandomList(amount=code_block_2, value1=code_block_3, value2=count, seed=number_slider)
round = Math.Round(number=randomList)
getItemAtIndex = List.GetItemAtIndex(list=flatten, index=round)
watch = Watch(getItemAtIndex)
code_block_4 = CodeBlock(a=watch) { a[0]; a[1]; a[2]; a[3]; }
X = Point.X(point=code_block_4.out0)
Y = Point.Y(point=code_block_4.out0)
code_block_5 = CodeBlock { 0; }
byCoordinates_2 = Point.ByCoordinates(x=X, y=Y, z=code_block_5)
X_2 = Point.X(point=code_block_4.out1)
Y_2 = Point.Y(point=code_block_4.out1)
byCoordinates_3 = Point.ByCoordinates(x=X_2, y=Y_2, z=code_block_5)
X_3 = Point.X(point=code_block_4.out2)
Y_3 = Point.Y(point=code_block_4.out2)
byCoordinates_4 = Point.ByCoordinates(x=X_3, y=Y_3, z=code_block_5)
X_4 = Point.X(point=code_block_4.out3)
Y_4 = Point.Y(point=code_block_4.out3)
byCoordinates_5 = Point.ByCoordinates(x=X_4, y=Y_4, z=code_block_5)

# group: Box 생성부
code_block_6 = CodeBlock { 100; 150; }
byCoordinates_6 = Point.ByCoordinates(x=code_block_6.out0, y=code_block_6.out1)
code_block_7 = CodeBlock { 100; 350; 200; }
byCoordinates_7 = Point.ByCoordinates(x=code_block_7.out1, y=code_block_7.out2)
code_block_8 = CodeBlock { 100; }
byLengths = Cuboid.ByLengths(origin=byCoordinates_2, width=code_block_8, length=code_block_8, height=code_block_8)
code_block_9 = CodeBlock { 100; 150; }
byLengths_2 = Cuboid.ByLengths(origin=byCoordinates_3, width=code_block_9.out0, length=code_block_9.out1, height=code_block_9.out0)
code_block_10 = CodeBlock { 100; 150; 200; }
byLengths_3 = Cuboid.ByLengths(origin=byCoordinates_4, width=code_block_10.out2, length=code_block_10.out1, height=code_block_10.out0)
code_block_11 = CodeBlock { 100; 250; 300; }
byLengths_4 = Cuboid.ByLengths(origin=byCoordinates_5, width=code_block_11.out2, length=code_block_11.out1, height=code_block_11.out0)
code_block_12 = CodeBlock { 350; 450; 500; }
byCoordinates_8 = Point.ByCoordinates(x=code_block_12.out1, y=code_block_12.out2)

# group: Gathering Seed
gathering_seed = DoubleSlider(768, range=0..2000 step 1)  # graph input

# group: Solid 중점 추출 및 Data Pouch 형성
join = List.Join(list0=byLengths, list1=byLengths_2, list2=byLengths_3, list3=byLengths_4)
centroid = Solid.Centroid(solid=byLengths)
centroid_2 = Solid.Centroid(solid=byLengths_2)
centroid_3 = Solid.Centroid(solid=byLengths_3)
centroid_4 = Solid.Centroid(solid=byLengths_4)
join_2 = List.Join(list0=centroid, list1=centroid_2, list2=centroid_3, list3=centroid_4)
code_block_13 = CodeBlock(BoxGeometry=join, BoxCenterPoint=join_2, GatheringSeed=gathering_seed)
# ---------- code_block_13.designscript (5 lines) ----------
{
"BoxGeometry": _BoxGeometry,
"BoxCenterPoint": _BoxCenterPoint,
"GatheringSeed": _GatheringSeed
};
# ----------------------------------------

# group: 각 센터 중점에서 Cluster 중점으로의 벡터 형성
code_block_14 = CodeBlock(InputDic=code_block_13) { _InputDic; }
code_block_15 = CodeBlock { "BoxCenterPoint"; }
valueAtKey = DesignScript.Builtin.Dictionary.ValueAtKey(dictionary=code_block_14, key=code_block_15)
python_script = Python(IN[0]=valueAtKey)  # IronPython2
# ---------- python_script.python (55 lines) ----------
import clr
clr.AddReference('ProtoGeometry')
from Autodesk.DesignScript.Geometry import *

def ToVals(pt):
	return [pt.X,pt.Y,pt.Z]

def ToPts(ptVals):
	return Point.ByCoordinates(ptVals[0],ptVals[1],ptVals[2])

def CreateOutline(pts):
	crvs = []
	i = 0
	while i < len(pts):
		if i == len(pts)-1:
			crvs.append(Line.ByStartPointEndPoint(pts[i],pts[0]))
		else:
			crvs.append(Line.ByStartPointEndPoint(pts[i],pts[i+1]))
		i = i+1
	return PolyCurve.ByJoinedCurves(crvs)

'''
Taken from Thomas Switzers awesome GitHub repo and modified to suit Dynamo Context
https://gist.github.com/arthur-e/5cf52962341310f438e96c1f3c3398b8
I take zero credit for this work other than porting it across.
'''
def convex_hull_graham(points):
	'''
	Returns points on convex hull in CCW order according to Graham's scan algorithm. 
	By Tom Switzer <thomas.switzer@gmail.com>.
	'''
	TURN_LEFT, TURN_RIGHT, TURN_NONE = (1, -1, 0)

	def cmp(a, b):
		return (a > b) - (a < b)
	
	def turn(p, q, r):
		return cmp((q[0] - p[0])*(r[1] - p[1]) - (r[0] - p[0])*(q[1] - p[1]), 0)
	
	def _keep_left(hull, r):
		while len(hull) > 1 and turn(hull[-2], hull[-1], r) != TURN_LEFT:
			hull.pop()
		if not len(hull) or hull[-1] != r:
			hull.append(r)
		return hull

	points = [ToVals(p) for p in points]	
	points = sorted(points)
	l = reduce(_keep_left, points, [])
	u = reduce(_keep_left, reversed(points), [])
	points = l.extend(u[i] for i in range(1, len(u) - 1)) or l
	points = [ToPts(p) for p in points]
	return CreateOutline(points)

OUT = convex_hull_graham(IN[0])
# ----------------------------------------
byPatch = Surface.ByPatch(closedCurve=python_script)
thicken = Surface.Thicken(surface=byPatch)
centroid_5 = Solid.Centroid(solid=thicken)
byTwoPoints = Vector.ByTwoPoints(start=valueAtKey, end=centroid_5)
code_block_16 = CodeBlock(VectorToCenter=byTwoPoints)
# ---------- code_block_16.designscript (3 lines) ----------
{
"VectorToCenter": _VectorToCenter
};
# ----------------------------------------
extendsChildDictionaryFromParent = Custom[ExtendsChildDictionaryFromParent](ParentDic=code_block_14, ChildDic=code_block_16)  # Extends Child Dictionary From Parent

# group: Cluster Gathering
code_block_17 = CodeBlock(InputDic=extendsChildDictionaryFromParent.dictionary) { _InputDic; }
code_block_18 = CodeBlock { "BoxGeometry"; }
valueAtKey_2 = DesignScript.Builtin.Dictionary.ValueAtKey(dictionary=code_block_17, key=code_block_18)
code_block_19 = CodeBlock { "VectorToCenter"; }
valueAtKey_3 = DesignScript.Builtin.Dictionary.ValueAtKey(dictionary=code_block_17, key=code_block_19)
count_2 = List.Count(list=valueAtKey_3)
code_block_20 = CodeBlock { 2; }
ofRepeatedItem = List.OfRepeatedItem(item=count_2, amount=code_block_20)
code_block_21 = CodeBlock { 0; 1; }
code_block_22 = CodeBlock { 2; }
code_block_23 = CodeBlock { 0; 2000; }
code_block_24 = CodeBlock { "GatheringSeed"; }
valueAtKey_4 = DesignScript.Builtin.Dictionary.ValueAtKey(dictionary=code_block_17, key=code_block_24)
randomList_2 = Math.RandomList(amount=code_block_22, value1=code_block_23.out0, value2=code_block_23.out1, seed=valueAtKey_4)
randomList_3 = Math.RandomList(amount=ofRepeatedItem, value1=code_block_21.out0, value2=code_block_21.out1, seed=randomList_2)
code_block_25 = CodeBlock { 0; }
getItemAtIndex_2 = List.GetItemAtIndex(list=randomList_3, index=code_block_25)
code_block_26 = CodeBlock { 1; }
getItemAtIndex_3 = List.GetItemAtIndex(list=randomList_3, index=code_block_26)
scale = Vector.Scale(vector=valueAtKey_3, xScaleFactor=getItemAtIndex_2, yScaleFactor=getItemAtIndex_3)
translate = Geometry.Translate(geometry=valueAtKey_2, direction=scale)
code_block_27 = CodeBlock(GatheredBoxGeometry=translate)
# ---------- code_block_27.designscript (3 lines) ----------
{
"GatheredBoxGeometry": _GatheredBoxGeometry
};
# ----------------------------------------
extendsChildDictionaryFromParent_2 = Custom[ExtendsChildDictionaryFromParent](ParentDic=code_block_17, ChildDic=code_block_27)

# group: Gathered CenterPoint 추출
code_block_28 = CodeBlock(InputDic=extendsChildDictionaryFromParent_2.dictionary) { _InputDic; }
code_block_29 = CodeBlock { "GatheredBoxGeometry"; }
valueAtKey_5 = DesignScript.Builtin.Dictionary.ValueAtKey(dictionary=code_block_28, key=code_block_29)
centroid_6 = Solid.Centroid(solid=valueAtKey_5)
code_block_30 = CodeBlock(GatheredBoxCenterPoint=centroid_6)
# ---------- code_block_30.designscript (3 lines) ----------
{
"GatheredBoxCenterPoint": _GatheredBoxCenterPoint
};
# ----------------------------------------
extendsChildDictionaryFromParent_3 = Custom[ExtendsChildDictionaryFromParent](ParentDic=code_block_28, ChildDic=code_block_30)

# group: GathereBoxCenterPoint 와 GatheredBoxGeometry 추출 및 데이터 결합
code_block_31 = CodeBlock(InputDic=extendsChildDictionaryFromParent_3.dictionary) { _InputDic; }
code_block_32 = CodeBlock { "GatheredBoxCenterPoint"; }
valueAtKey_6 = DesignScript.Builtin.Dictionary.ValueAtKey(dictionary=code_block_31, key=code_block_32)
code_block_33 = CodeBlock { "GatheredBoxGeometry"; }
valueAtKey_7 = DesignScript.Builtin.Dictionary.ValueAtKey(dictionary=code_block_31, key=code_block_33)
list_create = List.Create(item0=valueAtKey_6, item1=valueAtKey_7)
transpose = List.Transpose(lists=list_create)
code_block_34 = CodeBlock(GatheredDataTranspos=transpose)
# ---------- code_block_34.designscript (3 lines) ----------
{
"GatheredDataTransposeDic": _GatheredDataTransposeDic
};
# ----------------------------------------
extendsChildDictionaryFromParent_4 = Custom[ExtendsChildDictionaryFromParent](ParentDic=code_block_31, ChildDic=code_block_34)

# group: Cluster 구성 중 면적 상위 1,2 위 선택
code_block_35 = CodeBlock(InputDic=extendsChildDictionaryFromParent_4.dictionary) { _InputDic; }
code_block_36 = CodeBlock { "GatheredBoxGeometry"; }
valueAtKey_8 = DesignScript.Builtin.Dictionary.ValueAtKey(dictionary=code_block_35, key=code_block_36)
explode = Geometry.Explode(geometry=valueAtKey_8)
firstItem = List.FirstItem(list=explode@L2)
area = Surface.Area(surface=firstItem)
maximumItem = List.MaximumItem(list=area)
allIndicesOf = List.AllIndicesOf(list=area, item=maximumItem)
removeItemAtIndex = List.RemoveItemAtIndex(list=area, indices=allIndicesOf)
maximumItem_2 = List.MaximumItem(list=removeItemAtIndex)
allIndicesOf_2 = List.AllIndicesOf(list=area, item=maximumItem_2)
join_3 = List.Join(list0=allIndicesOf, list1=allIndicesOf_2)
code_block_37 = CodeBlock(BoxUpperSurface=firstItem, BoxAreaTop2IndexOfCl=join_3)
# ---------- code_block_37.designscript (4 lines) ----------
{
"BoxUpperSurface": _BoxUpperSurface,
"BoxAreaTop2IndexOfCluster": _BoxAreaTop2IndexOfCluster
};
# ----------------------------------------
extendsChildDictionaryFromParent_5 = Custom[ExtendsChildDictionaryFromParent](ParentDic=code_block_35, ChildDic=code_block_37)

# group: Box Alignment(우상단 정렬 기준)
code_block_38 = CodeBlock(InputDic=extendsChildDictionaryFromParent_5.dictionary) { _InputDic; }
code_block_39 = CodeBlock { "GatheredBoxGeometry"; }
valueAtKey_9 = DesignScript.Builtin.Dictionary.ValueAtKey(dictionary=code_block_38, key=code_block_39)
code_block_40 = CodeBlock { "BoxAreaTop2IndexOfCluster"; }
valueAtKey_10 = DesignScript.Builtin.Dictionary.ValueAtKey(dictionary=code_block_38, key=code_block_40)
lastItem = List.LastItem(list=valueAtKey_10)
# note: 좌하단 정렬 기준도 추가하고 if와 랜덤 시드 부여
code_block_41 = CodeBlock { "BoxUpperSurface"; }
valueAtKey_11 = DesignScript.Builtin.Dictionary.ValueAtKey(dictionary=code_block_38, key=code_block_41)
code_block_42 = CodeBlock { 1; }
pointAtParameter = Surface.PointAtParameter(surface=valueAtKey_11, u=code_block_42, v=code_block_42)
getItemAtIndex_4 = List.GetItemAtIndex(list=pointAtParameter, index=valueAtKey_10)
X_5 = Point.X(point=getItemAtIndex_4)
x_difference = CodeBlock(i=X_5) { i[0]-i[1]; }
Y_5 = Point.Y(point=getItemAtIndex_4)
y_difference = CodeBlock(i=Y_5) { i[0]-i[1]; }
code_block_43 = CodeBlock(a=x_difference, b=y_difference) { Math.Abs(a)<Math.Abs(b); }
getItemAtIndex_5 = List.GetItemAtIndex(list=valueAtKey_9, index=lastItem)
translate_2 = Geometry.Translate(geometry=getItemAtIndex_5, xTranslation=x_difference)
translate_3 = Geometry.Translate(geometry=getItemAtIndex_5, yTranslation=y_difference)
if_ = If(test=code_block_43, true=translate_2, false=translate_3)
replaceItemAtIndex = List.ReplaceItemAtIndex(list=valueAtKey_9, index=lastItem, item=if_)
centroid_7 = Solid.Centroid(solid=replaceItemAtIndex)
code_block_44 = CodeBlock(AlignedBoxGeometry=replaceItemAtIndex, AlignedBoxCenterPoint=centroid_7)
# ---------- code_block_44.designscript (4 lines) ----------
{
"AlignedBoxGeometry": _AlignedBoxGeometry,
"AlignedBoxCenterPoint": _AlignedBoxCenterPoint
};
# ----------------------------------------
extendsChildDictionaryFromParent_6 = Custom[ExtendsChildDictionaryFromParent](ParentDic=code_block_38, ChildDic=code_block_44)

color_palette = ColorPalette({R: 124, G: 252, B: 0, A: 105})
byGeometryColor = Modifiers.GeometryColor.ByGeometryColor(geometry=replaceItemAtIndex, color=color_palette)

# group: AlignedBoxCenterPoint 와 AlignedBoxGeometry 추출 및 데이터 결합
code_block_45 = CodeBlock(InputDic=extendsChildDictionaryFromParent_6.dictionary) { _InputDic; }
code_block_46 = CodeBlock { "AlignedBoxCenterPoint"; }
valueAtKey_12 = DesignScript.Builtin.Dictionary.ValueAtKey(dictionary=code_block_45, key=code_block_46)
code_block_47 = CodeBlock { "AlignedBoxGeometry"; }
valueAtKey_13 = DesignScript.Builtin.Dictionary.ValueAtKey(dictionary=code_block_45, key=code_block_47)
list_create_2 = List.Create(item0=valueAtKey_12, item1=valueAtKey_13)
transpose_2 = List.Transpose(lists=list_create_2)
code_block_48 = CodeBlock(AlignedDataTransposeDic=transpose_2)
# ---------- code_block_48.designscript (3 lines) ----------
{
"AlignedDataTransposeDic": _AlignedDataTransposeDic
};
# ----------------------------------------
extendsChildDictionaryFromParent_7 = Custom[ExtendsChildDictionaryFromParent](ParentDic=code_block_45, ChildDic=code_block_48)

# group: Effective Combination 형성
code_block_49 = CodeBlock(InputDic=extendsChildDictionaryFromParent_7.dictionary) { _InputDic; }
code_block_50 = CodeBlock { "AlignedDataTransposeDic"; }
valueAtKey_14 = DesignScript.Builtin.Dictionary.ValueAtKey(dictionary=code_block_49, key=code_block_50)
code_block_51 = CodeBlock { 2; }
combinations = List.Combinations(list=valueAtKey_14, length=code_block_51)
transpose_3 = List.Transpose(lists=combinations@L3)
flatten_2 = List.Flatten(list=transpose_3@L3)
code_block_52 = CodeBlock(EffectiveCombination=flatten_2)
# ---------- code_block_52.designscript (3 lines) ----------
{
"EffectiveCombinationList": _EffectiveCombinationList
};
# ----------------------------------------
extendsChildDictionaryFromParent_8 = Custom[ExtendsChildDictionaryFromParent](ParentDic=code_block_49, ChildDic=code_block_52)

# group: Effective 전처리: Point to Line
code_block_53 = CodeBlock(InputDic=extendsChildDictionaryFromParent_8.dictionary) { _InputDic; }
code_block_54 = CodeBlock { "EffectiveCombinationList"; }
valueAtKey_15 = DesignScript.Builtin.Dictionary.ValueAtKey(dictionary=code_block_53, key=code_block_54)
code_block_55 = CodeBlock { [0,1]; }
getItemAtIndex_6 = List.GetItemAtIndex(list=valueAtKey_15@L2, index=code_block_55)
code_block_56 = CodeBlock { 0; }
getItemAtIndex_7 = List.GetItemAtIndex(list=getItemAtIndex_6@L2, index=code_block_56)
code_block_57 = CodeBlock { 1; }
getItemAtIndex_8 = List.GetItemAtIndex(list=getItemAtIndex_6@L2, index=code_block_57)
byStartPointEndPoint = Line.ByStartPointEndPoint(startPoint=getItemAtIndex_7, endPoint=getItemAtIndex_8)
code_block_58 = CodeBlock(EffectiveCombination=byStartPointEndPoint)
# ---------- code_block_58.designscript (3 lines) ----------
{
"EffectiveCombinationLine": _EffectiveCombinationLine
};
# ----------------------------------------
extendsChildDictionaryFromParent_9 = Custom[ExtendsChildDictionaryFromParent](ParentDic=code_block_53, ChildDic=code_block_58)

# group: Effective 전처리: Solid to Combination Solid
code_block_59 = CodeBlock(InputDic=extendsChildDictionaryFromParent_9.dictionary) { _InputDic; }
code_block_60 = CodeBlock { "EffectiveCombinationList"; }
valueAtKey_16 = DesignScript.Builtin.Dictionary.ValueAtKey(dictionary=code_block_59, key=code_block_60)
code_block_61 = CodeBlock { [2,3]; }
getItemAtIndex_9 = List.GetItemAtIndex(list=valueAtKey_16@L2, index=code_block_61)
byUnion = Solid.ByUnion(solids=getItemAtIndex_9@L2)
code_block_62 = CodeBlock(EffectiveCombination=getItemAtIndex_9)
# ---------- code_block_62.designscript (3 lines) ----------
{
"EffectiveCombinationSolid": _EffectiveCombinationSolid
};
# ----------------------------------------
extendsChildDictionaryFromParent_10 = Custom[ExtendsChildDictionaryFromParent](ParentDic=code_block_59, ChildDic=code_block_62)

# group: Effective Line 추출 및 Effective Length 편차 총합
code_block_63 = CodeBlock(InputDic=extendsChildDictionaryFromParent_10.dictionary) { _InputDic; }
code_block_64 = CodeBlock { "EffectiveCombinationLine"; }
valueAtKey_17 = DesignScript.Builtin.Dictionary.ValueAtKey(dictionary=code_block_63, key=code_block_64)
length = Curve.Length(curve=valueAtKey_17)
code_block_65 = CodeBlock { "EffectiveCombinationSolid"; }
valueAtKey_18 = DesignScript.Builtin.Dictionary.ValueAtKey(dictionary=code_block_63, key=code_block_65)
intersect = Geometry.Intersect(geometry=valueAtKey_17@L1, other=valueAtKey_18@L1)
length_2 = Curve.Length(curve=intersect)
sum = Math.Sum(values=length_2)
sub = length - sum
effective_length_편차_총합 = Math.Sum(values=sub)  # graph output

intersect_2 = Geometry.Intersect(geometry=valueAtKey_18, other=valueAtKey_18, lacing=CrossProduct)
flatten_3 = List.Flatten(list=intersect_2)
volume = Solid.Volume(solid=flatten_3)
박스_겹침_체적 = Math.Sum(values=volume)  # graph output
code_block_66 = CodeBlock { "GatheredBoxGeometry"; }
valueAtKey_19 = DesignScript.Builtin.Dictionary.ValueAtKey(dictionary=code_block_63, key=code_block_66)
explode_2 = Geometry.Explode(geometry=valueAtKey_19)
firstItem_2 = List.FirstItem(list=explode_2@L2)
perimeterCurves = Surface.PerimeterCurves(surface=firstItem_2)
startPoint = Curve.StartPoint(curve=perimeterCurves)
X_6 = Point.X(point=startPoint)
flatten_4 = List.Flatten(list=X_6)
uniqueItems = List.UniqueItems(list=flatten_4)
x축_다양성 = List.Count(list=uniqueItems)  # graph output
Y_6 = Point.Y(point=startPoint)
flatten_5 = List.Flatten(list=Y_6)
uniqueItems_2 = List.UniqueItems(list=flatten_5)
y축_다양성 = List.Count(list=uniqueItems_2)  # graph output
watch_2 = Watch(valueAtKey_18)
watch_3 = Watch(valueAtKey_17)

# group: Find OverlapedBox Index
code_block_67 = CodeBlock(InputDic=extendsChildDictionaryFromParent_10.dictionary) { _InputDic; }
code_block_68 = CodeBlock { "AlignedBoxGeometry"; }
valueAtKey_20 = DesignScript.Builtin.Dictionary.ValueAtKey(dictionary=code_block_67, key=code_block_68)
count_3 = List.Count(list=valueAtKey_20)
code_block_69 = CodeBlock(i=count_3) { 0..i-1; }
list_create_3 = List.Create(item0=valueAtKey_20, item1=code_block_69)
transpose_4 = List.Transpose(lists=list_create_3)
code_block_70 = CodeBlock { 2; }
combinations_2 = List.Combinations(list=transpose_4, length=code_block_70)
firstItem_3 = List.FirstItem(list=combinations_2@L3)
lastItem_2 = List.LastItem(list=firstItem_3@L2)
firstItem_4 = List.FirstItem(list=firstItem_3@L2)
lastItem_3 = List.LastItem(list=combinations_2@L3)
firstItem_5 = List.FirstItem(list=lastItem_3@L2)
doesIntersect = Geometry.DoesIntersect(geometry=firstItem_4@L1, other=firstItem_5@L1)
boolean = BoolSelector(true)
allIndicesOf_3 = List.AllIndicesOf(list=doesIntersect, item=boolean)
getItemAtIndex_10 = List.GetItemAtIndex(list=lastItem_2, index=allIndicesOf_3)
lastItem_4 = List.LastItem(list=lastItem_3@L2)
getItemAtIndex_11 = List.GetItemAtIndex(list=lastItem_4, index=allIndicesOf_3)
list_create_4 = List.Create(item0=getItemAtIndex_10, item1=getItemAtIndex_11)
transpose_5 = List.Transpose(lists=list_create_4)
code_block_71 = CodeBlock(OverlapedBoxIndex=transpose_5)
# ---------- code_block_71.designscript (3 lines) ----------
{
"OverlapedBoxIndex": _OverlapedBoxIndex
};
# ----------------------------------------
extendsChildDictionaryFromParent_11 = Custom[ExtendsChildDictionaryFromParent](ParentDic=code_block_67, ChildDic=code_block_71)

code_block_72 = CodeBlock(InputDic=extendsChildDictionaryFromParent_11.dictionary) { _InputDic; }
code_block_73 = CodeBlock { "AlignedBoxGeometry"; }
valueAtKey_21 = DesignScript.Builtin.Dictionary.ValueAtKey(dictionary=code_block_72, key=code_block_73)
code_block_74 = CodeBlock { "OverlapedBoxIndex"; }
# note: 하부 인덱스 0번을 움직이면 됨
valueAtKey_22 = DesignScript.Builtin.Dictionary.ValueAtKey(dictionary=code_block_72, key=code_block_74)
getItemAtIndex_12 = List.GetItemAtIndex(list=valueAtKey_21, index=valueAtKey_22)
firstItem_6 = List.FirstItem(list=getItemAtIndex_12@L2)
lastItem_5 = List.LastItem(list=getItemAtIndex_12@L2)
intersect_3 = Geometry.Intersect(geometry=firstItem_6, other=lastItem_5)
explode_3 = Geometry.Explode(geometry=intersect_3)
normalAtParameter = Surface.NormalAtParameter(surface=explode_3)
code_block_75 = CodeBlock(i=normalAtParameter) { Vector.Z(i)==-1; }
boolean_2 = BoolSelector(true)
allIndicesOf_4 = List.AllIndicesOf(list=code_block_75@L2, item=boolean_2)
getItemAtIndex_13 = List.GetItemAtIndex(list=explode_3@L2, index=allIndicesOf_4@L2)
pointAtParameter_2 = Surface.PointAtParameter(surface=getItemAtIndex_13)
code_block_76 = CodeBlock { 1; }
pointAtParameter_3 = Surface.PointAtParameter(surface=getItemAtIndex_13, u=code_block_76)
byTwoPoints_2 = Vector.ByTwoPoints(start=pointAtParameter_2, end=pointAtParameter_3)
length_3 = Vector.Length(vector=byTwoPoints_2)
code_block_77 = CodeBlock { 1; }
pointAtParameter_4 = Surface.PointAtParameter(surface=getItemAtIndex_13, v=code_block_77)
byTwoPoints_3 = Vector.ByTwoPoints(start=pointAtParameter_2, end=pointAtParameter_4)
length_4 = Vector.Length(vector=byTwoPoints_3)
code_block_78 = CodeBlock(Xvector=length_3, Yvector=length_4) { Xvector<Yvector; }
if_2 = If(test=code_block_78, true=byTwoPoints_2, false=byTwoPoints_3)
translate_4 = Geometry.Translate()  # unwired: geometry, direction
flatten_6 = List.Flatten(list=valueAtKey_22)
uniqueItems_3 = List.UniqueItems(list=flatten_6)
contains = List.Contains(list=flatten_6, item=uniqueItems_3, lacing=CrossProduct)
transpose_6 = List.Transpose(lists=contains)
countTrue = List.CountTrue(list=transpose_6@L2)
code_block_79 = CodeBlock(i=countTrue) { i>1?true:false; }
boolean_3 = BoolSelector(true)
allIndicesOf_5 = List.AllIndicesOf(list=code_block_79, item=boolean_3)
getItemAtIndex_14 = List.GetItemAtIndex(list=uniqueItems_3, index=allIndicesOf_5)
getItemAtIndex_15 = List.GetItemAtIndex(list=valueAtKey_21, index=getItemAtIndex_14)
python_script_2 = Python(IN[0]=valueAtKey_21)  # CPython3
# ---------- python_script_2.python (44 lines) ----------
# Load the Python Standard and DesignScript Libraries
import sys
import clr
clr.AddReference('ProtoGeometry')
from Autodesk.DesignScript.Geometry import *

# The inputs to this node will be stored as a list in the IN variables.
dataEnteringNode = IN
ListIn = IN[0]
BeforeList = ListIn[:]
TargetList = []
TranslatedList = []

#del ListIn[ListIn.index(0)]
BlnForIntsct = []
IndexForIntsct = []
for i in ListIn:
    Target = i
    #BeforeList.remove(Target)
    
    for j in range(len(BeforeList)):
        a = Geometry.DoesIntersect(Target,BeforeList[j])
        BlnForIntsct.append(a)
        for k in BlnForIntsct:
            IndexForIntsct.append(BlnForIntsct.index(True))
    	   
	

	   
	   
#	   for k in range(len(BeforeList)):
#	       b = Geometry.DoesIntersect(TargetList[j],BeforeList[k])
#	       BlnForIntsct.append(b)
	   
	   
	   #TranslatedList.append(BlnForIntsct)
	
	
	##Geometry.DoesIntersect

# Place your code below this line

# Assign your output to the OUT variable.
OUT = BlnForIntsct
# ----------------------------------------
watch_4 = Watch(valueAtKey_21)
code_block_80 = CodeBlock { 0; }
code_block_81 = CodeBlock(a=watch_4) { a[0]; }
centroid_8 = Solid.Centroid(solid=code_block_81)
doesIntersect_2 = Geometry.DoesIntersect(geometry=code_block_81, other=watch_4)
filterByBoolMask = List.FilterByBoolMask(list=watch_4, mask=doesIntersect_2)
watch_5 = Watch(filterByBoolMask.in)
volume_2 = Solid.Volume(solid=code_block_81)
volume_3 = Solid.Volume(solid=watch_5)
eq = volume_2 == volume_3
filterByBoolMask_2 = List.FilterByBoolMask(list=watch_5, mask=eq)
watch_6 = Watch(filterByBoolMask_2.out)
flatten_7 = List.Flatten(list=watch_6)
intersect_4 = Geometry.Intersect(geometry=code_block_81, other=flatten_7)
flatten_8 = List.Flatten(list=intersect_4)
centroid_9 = Solid.Centroid(solid=flatten_8)
byStartPointEndPoint_2 = Line.ByStartPointEndPoint(startPoint=centroid_8, endPoint=centroid_9)
intersect_5 = Geometry.Intersect(geometry=byStartPointEndPoint_2, other=flatten_8)
flatten_9 = List.Flatten(list=intersect_5)
direction = Line.Direction(line=flatten_9)
reverse = Vector.Reverse(vector=direction)
translate_5 = Geometry.Translate(geometry=code_block_81, direction=reverse)
translate_6 = Geometry.Translate(geometry=translate_5, direction=reverse)
replaceItemAtIndex_2 = List.ReplaceItemAtIndex(list=watch_4, index=code_block_80, item=translate_6)
flatten_10 = List.Flatten(list=replaceItemAtIndex_2)
watch_7 = Watch(flatten_10)
code_block_82 = CodeBlock { 1; }
code_block_83 = CodeBlock(a=watch_7) { a[1]; }
centroid_10 = Solid.Centroid(solid=code_block_83)
doesIntersect_3 = Geometry.DoesIntersect(geometry=code_block_83, other=watch_7)
filterByBoolMask_3 = List.FilterByBoolMask(list=watch_7, mask=doesIntersect_3)
watch_8 = Watch(filterByBoolMask_3.in)
volume_4 = Solid.Volume(solid=code_block_83)
volume_5 = Solid.Volume(solid=watch_8)
eq_2 = volume_4 == volume_5
filterByBoolMask_4 = List.FilterByBoolMask(list=watch_8, mask=eq_2)
watch_9 = Watch(filterByBoolMask_4.out)
flatten_11 = List.Flatten(list=watch_9)
intersect_6 = Geometry.Intersect(geometry=code_block_83, other=flatten_11)
flatten_12 = List.Flatten(list=intersect_6)
centroid_11 = Solid.Centroid(solid=flatten_12)
byStartPointEndPoint_3 = Line.ByStartPointEndPoint(startPoint=centroid_10, endPoint=centroid_11)
intersect_7 = Geometry.Intersect(geometry=byStartPointEndPoint_3, other=flatten_12)
flatten_13 = List.Flatten(list=intersect_7)
direction_2 = Line.Direction(line=flatten_13)
reverse_2 = Vector.Reverse(vector=direction_2)
translate_7 = Geometry.Translate(geometry=code_block_83, direction=reverse_2)
translate_8 = Geometry.Translate(geometry=translate_7, direction=reverse_2)
replaceItemAtIndex_3 = List.ReplaceItemAtIndex(list=watch_7, index=code_block_82, item=translate_8)
flatten_14 = List.Flatten(list=replaceItemAtIndex_3)
watch_10 = Watch(flatten_14)
code_block_84 = CodeBlock(a=watch_10) { a[2]; }
doesIntersect_4 = Geometry.DoesIntersect(geometry=code_block_84, other=watch_10)
filterByBoolMask_5 = List.FilterByBoolMask(list=watch_10, mask=doesIntersect_4)
watch_11 = Watch(filterByBoolMask_5.in)
volume_6 = Solid.Volume(solid=code_block_84)
volume_7 = Solid.Volume(solid=watch_11)
eq_3 = volume_6 == volume_7
filterByBoolMask_6 = List.FilterByBoolMask(list=watch_11, mask=eq_3)
watch_12 = Watch(filterByBoolMask_6.out)
flatten_15 = List.Flatten(list=watch_12)
intersect_8 = Geometry.Intersect(geometry=code_block_84, other=flatten_15)
flatten_16 = List.Flatten(list=intersect_8)
code_block_85 = CodeBlock { 2; }
centroid_12 = Solid.Centroid(solid=code_block_84)
volume_8 = Solid.Volume(solid=intersect_8)
isNull = Object.IsNull(object=volume_8)
uniqueItems_4 = List.UniqueItems(list=isNull@L2)
flatten_17 = List.Flatten(list=uniqueItems_4)
filterByBoolMask_7 = List.FilterByBoolMask(list=flatten_15, mask=flatten_17)
flatten_18 = List.Flatten(list=filterByBoolMask_7.out)
intersect_9 = Geometry.Intersect(geometry=code_block_84, other=flatten_18)
centroid_13 = Solid.Centroid(solid=intersect_9)
byStartPointEndPoint_4 = Line.ByStartPointEndPoint(startPoint=centroid_12, endPoint=centroid_13)
intersect_10 = Geometry.Intersect(geometry=byStartPointEndPoint_4, other=intersect_9)
flatten_19 = List.Flatten(list=intersect_10)
direction_3 = Line.Direction(line=flatten_19)
reverse_3 = Vector.Reverse(vector=direction_3)
translate_9 = Geometry.Translate(geometry=code_block_84, direction=reverse_3)
translate_10 = Geometry.Translate(geometry=translate_9, direction=reverse_3)
replaceItemAtIndex_4 = List.ReplaceItemAtIndex(list=watch_10, index=code_block_85, item=translate_10)
flatten_20 = List.Flatten(list=replaceItemAtIndex_4)
watch_13 = Watch(flatten_20)
code_block_86 = CodeBlock(a=watch_13) { a[3]; }
doesIntersect_5 = Geometry.DoesIntersect(geometry=code_block_86, other=watch_13)
filterByBoolMask_8 = List.FilterByBoolMask(list=watch_13, mask=doesIntersect_5)
watch_14 = Watch(filterByBoolMask_8.in)
volume_9 = Solid.Volume(solid=code_block_86)
volume_10 = Solid.Volume(solid=watch_14)
eq_4 = volume_9 == volume_10
filterByBoolMask_9 = List.FilterByBoolMask(list=watch_14, mask=eq_4)
watch_15 = Watch(filterByBoolMask_9.out)
flatten_21 = List.Flatten(list=watch_15)
intersect_11 = Geometry.Intersect(geometry=code_block_86, other=flatten_21)
flatten_22 = List.Flatten(list=intersect_11)
code_block_87 = CodeBlock { 3; }
centroid_14 = Solid.Centroid(solid=code_block_86)
volume_11 = Solid.Volume(solid=intersect_11)
isNull_2 = Object.IsNull(object=volume_11)
uniqueItems_5 = List.UniqueItems(list=isNull_2@L2)
flatten_23 = List.Flatten(list=uniqueItems_5)
filterByBoolMask_10 = List.FilterByBoolMask(list=flatten_21, mask=flatten_23)
flatten_24 = List.Flatten(list=filterByBoolMask_10.out)
intersect_12 = Geometry.Intersect(geometry=code_block_86, other=flatten_24)
centroid_15 = Solid.Centroid(solid=intersect_12)
byStartPointEndPoint_5 = Line.ByStartPointEndPoint(startPoint=centroid_14, endPoint=centroid_15)
intersect_13 = Geometry.Intersect(geometry=byStartPointEndPoint_5, other=intersect_12)
flatten_25 = List.Flatten(list=intersect_13)
direction_4 = Line.Direction(line=flatten_25)
reverse_4 = Vector.Reverse(vector=direction_4)
translate_11 = Geometry.Translate(geometry=code_block_86, direction=reverse_4)
translate_12 = Geometry.Translate(geometry=translate_11, direction=reverse_4)
replaceItemAtIndex_5 = List.ReplaceItemAtIndex(list=watch_13, index=code_block_87, item=translate_12)
flatten_26 = List.Flatten(list=replaceItemAtIndex_5)
