# Dynamo graph 0817 test code.dyn (Dynamo 2.11.0.4533)

code_block = CodeBlock { 3..6..1; }
byWidthLength = Rectangle.ByWidthLength(width=code_block, length=code_block)
number_slider = DoubleSlider(3, range=0..100 step 0.1)
ofRepeatedItem = List.OfRepeatedItem(item=byWidthLength, amount=number_slider)
flatten = List.Flatten(list=ofRepeatedItem)
byPatch = Surface.ByPatch(closedCurve=flatten)
code_block_2 = CodeBlock { 0..20..1; }
byCoordinates = Point.ByCoordinates(x=code_block_2, y=code_block_2, lacing=CrossProduct)
flatten_2 = List.Flatten(list=byCoordinates)
watch = Watch(flatten_2)
X = Point.X(point=watch)
Y = Point.Y(point=watch)
Z = Point.Z(point=watch)
byCoordinates_2 = Point.ByCoordinates(x=X, y=Y, z=Z)
watch_2 = Watch()  # unwired: arg0
translate = Geometry.Translate(geometry=watch_2)
now = DateTime.Now()
python_script = Python(IN[0]=watch_2, IN[1]=watch, IN[2]=now)  # IronPython2
# ---------- python_script.python (48 lines) ----------
# Python 표준 및 DesignScript 라이브러리 로드
import random
import sys
import clr
clr.AddReference('ProtoGeometry')
from Autodesk.DesignScript.Geometry import *

# 이 노드에 대한 입력값은 IN 변수에 리스트로 저장됩니다.
dataEnteringNode = IN


surfaces = IN[0]
points = IN[1]
checks = [False for i in range(len(points))]

random.seed(a=None)

n = len(surfaces)
cnt = 0

result = []

while cnt < n:
    r = random.randint(0, len(points) - 1)

    test = Geometry.Translate(surfaces[cnt], points[r].X, points[r].Y, points[r].Z)

    validCheck = True

    for i in range(0, len(points) - 1):
        if test.Intersect(points[i]) and checks[i] == True:
            validCheck = False
            break

    if validCheck == True:
        for i in range(0, len(points) - 1):
            if test.Intersect(points[i]):
                checks[i] = True
        cnt = cnt + 1
        result.append(test)
        



# 코드를 이 선 아래에 배치

# 출력을 OUT 변수에 지정합니다.
OUT = result
# ----------------------------------------
python_script_2 = Python(IN[0]=python_script)  # IronPython2
# ---------- python_script_2.python (176 lines) ----------
# Python 표준 및 DesignScript 라이브러리 로드
from random import randint
import sys
import clr
clr.AddReference('ProtoGeometry')
from Autodesk.DesignScript.Geometry import *



def GetXOrderSurfaces(sl):
    ls = []
    for s in sl:
        ls.append(SortByMinX(s))

    ls.sort()

    r = []
    for l in ls:
        r.append(l.val)

    return r

def GetYOrderSurfaces(sl):
    ls = []
    for s in sl:
        ls.append(SortByMinY(s))

    ls.sort()

    r = []
    for l in ls:
        r.append(l.val)

    return r

def GetIndexOfSurface(s, sl):
    for i in range(0, len(sl)):
        if sl[i] == s:
            return i

class SortByMinX(object):
     def __init__(self, val):
         self.val = val

     def __lt__(self, other):
         return self.val.PointAtParameter(0,0).X < other.val.PointAtParameter(0,0).X

class SortByMinY(object):
     def __init__(self, val):
         self.val = val

     def __lt__(self, other):
         return self.val.PointAtParameter(0,0).Y < other.val.PointAtParameter(0,0).Y


def CreateXCheckerSurface(s):
    min = s.PointAtParameter(0,0)
    max = s.PointAtParameter(1,1)
    pl = [
            Point.ByCoordinates(min.X - 100, min.Y + 0.1, 0),
            Point.ByCoordinates(min.X - 100, max.Y - 0.1, 0),
            Point.ByCoordinates(min.X, max.Y - 0.1, 0),
            Point.ByCoordinates(min.X, min.Y + 0.1, 0),
        ]

    checkerX = Surface.ByPerimeterPoints(pl)

    return checkerX

def CreateYCheckerSurface(s):
    min = s.PointAtParameter(0,0)
    max = s.PointAtParameter(1,1)
    pl = [
            Point.ByCoordinates(min.X + 0.1, min.Y - 100, 0),
            Point.ByCoordinates(min.X + 0.1, min.Y, 0),
            Point.ByCoordinates(max.X - 0.1, min.Y, 0),
            Point.ByCoordinates(max.X - 0.1, min.Y - 100, 0),
        ]

    checkerX = Surface.ByPerimeterPoints(pl)

    return checkerX

def GetDistanceXToMove(s, sl):
    checkerX = CreateXCheckerSurface(s)

    cl = []

    noHit = True

    for si in sl:
        if si == s:
            continue
        else:
            if checkerX.DoesIntersect(si) == True:
                noHit = False

                cl.append(si.PointAtParameter(0,0).X)
                cl.append(si.PointAtParameter(1,1).X)

    if noHit == True:
        return -s.PointAtParameter(0,0).X
    else:
        cl.sort(reverse=True)
        return cl[0] - s.PointAtParameter(0,0).X

def GetDistanceYToMove(s, sl):
    checkerY = CreateYCheckerSurface(s)

    cl = []

    noHit = True

    for si in sl:
        if si == s:
            continue
        else:
            if checkerY.DoesIntersect(si) == True:
                noHit = False

                cl.append(si.PointAtParameter(0,0).Y)
                cl.append(si.PointAtParameter(1,1).Y)

    if noHit == True:
        return -s.PointAtParameter(0,0).Y
    else:
        cl.sort(reverse=True)
        return cl[0] - s.PointAtParameter(0,0).Y


def MoveX():
    xOrdered = GetXOrderSurfaces(surfacelist)

    for s in xOrdered:    
        toMoveX = GetDistanceXToMove(s, surfacelist)
        idx = GetIndexOfSurface(s, surfacelist)
        surfacelist[idx] = Geometry.Translate(surfacelist[idx], toMoveX, 0, 0)

def MoveY():
    yOrdered = GetYOrderSurfaces(surfacelist)

    for s in yOrdered:
        toMoveY = GetDistanceYToMove(s, surfacelist)
        idx = GetIndexOfSurface(s, surfacelist)
        surfacelist[idx] = Geometry.Translate(surfacelist[idx], 0, toMoveY, 0)


       


# 이 노드에 대한 입력값은 IN 변수에 리스트로 저장됩니다.
dataEnteringNode = IN

# 코드를 이 선 아래에 배치

surfaces = IN[0]

surfacelist = []
for s in surfaces:
    surfacelist.append(s)

for i in range(0, len(surfacelist)):
    surfacelist[i] = Geometry.Translate(surfacelist[i], 10, 10, 0)

if randint(0, 1) == 0:
    MoveX()
    MoveY()
    MoveX()
else:
    MoveY()
    MoveX()
    MoveY()


# 출력을 OUT 변수에 지정합니다.
OUT = surfacelist
# ----------------------------------------
perimeterCurves = Surface.PerimeterCurves(surface=python_script_2)
startPoint = Curve.StartPoint(curve=perimeterCurves)
boolean = BoolSelector(true)
byPoints = PolyCurve.ByPoints(points=startPoint, connectLastToFirst=boolean)
code_block_3 = CodeBlock { -0.2; }
offset = Curve.Offset(curve=byPoints, distance=code_block_3)
list_create = List.Create(item0=byPoints, item1=offset)
transpose = List.Transpose(lists=list_create)
byLoft = Surface.ByLoft(crossSections=transpose)
code_block_4 = CodeBlock { 3; }
boolean_2 = BoolSelector(false)
thicken = Surface.Thicken(surface=byLoft, thickness=code_block_4, both_sides=boolean_2)
