# Dynamo graph 0824-3 ldh space planning test 008CN_mk_수정_python.dyn (Dynamo 2.10.1.3976)
# packages: GenerativeDesign.Revit 1.7.3.0, GenerativeDesign 1.7.3.0, Clockwork for Dynamo 2.x 2.3.0

# group: User Inputs for GDIR
# note: Custom Package: GenerativeDesign v.2021.5.5
select_room_to_load_program_into = DSModelRoomSelection()  # 1 picked in the model; graph input
# note: Retrieve the room's finish boundary.
# Note: The first sublist is the outermost boundary of the room.
finishBoundary = Room.FinishBoundary(room=select_room_to_load_program_into)
remember = Data.Remember(finishBoundary)

# group: Extract room boundary for DynaSpace and cache it in the graph
firstItem = List.FirstItem(list=remember@L3)
startPoint = Curve.StartPoint(curve=firstItem)
flatten = List.Flatten(list=startPoint)
byJoinedCurves = PolyCurve.ByJoinedCurves(curves=firstItem)
code_block = CodeBlock(RoomBoundary=byJoinedCurves)
# ---------- code_block.designscript (3 lines) ----------
{
"RoomBoundary": _RoomBoundary
};
# ----------------------------------------

# group: Excel Data import (package 정리 전)
file_path = Filename("..\0802\space planning test 0802mk 001.xlsx")
file_from_path = FileObject(path=file_path)
string_from_object = FromObject(object=file_from_path)
code_block_2 = CodeBlock { "Sheet1"; "SampleBuildingProgram-Clinic"; false; }
python_script_import_excel_by = Python(IN[0]=string_from_object, IN[1]=code_block_2.out0)  # "Python Script@Import Excel(By OpenpyXl)"; CPython3
# ---------- python_script_import_excel_by.python (50 lines) ----------
# Load the Python Standard and DesignScript Libraries
import sys
import os
#sys.path.append(r'C:\Users\HEC\AppData\Local\Programs\Python\Python39\Lib\site-packages')
#sys.path.append(r'C:\Users\pjmk0\AppData\Local\Programs\Python\Python39\Lib\site-packages')
sys.path.append(os.getenv('LOCALAPPDATA').replace('\\','\\\\') + r'\Programs\Python\Python39\Lib\site-packages')
import clr
clr.AddReference('ProtoGeometry')
from Autodesk.DesignScript.Geometry import *
from collections import Iterable

def iterable(obj):
    return isinstance(obj, Iterable)


# The inputs to this node will be stored as a list in the IN variables.
dataEnteringNode = IN
PathIn = IN[0]
SheetNameIn = IN[1]

# Place your code below this line
import datetime
import openpyxl

path = (PathIn)
#path = (r'C:\Users\pjmk0\Downloads\MK\mQ\BIM_물량집계 자동화 산출기준표_rC(20210607)_mk_de.xlsx')

wb_obj = openpyxl.load_workbook(path, data_only=True)
sheet_obj = wb_obj.get_sheet_by_name(SheetNameIn)

m_row = sheet_obj.max_row
m_col = sheet_obj.max_column

listOut = []



for i in range(1, m_row +1):
    listTemp = []
    for j in range(1, m_col + 1):
        cell_obj = sheet_obj.cell(row=i, column=j)
        listTemp.append(cell_obj.value)
        if len(listTemp) == m_col:
            listOut.append(listTemp)
        


# Assign your output to the OUT variable.
OUT = listOut
#OUT = os.getenv('APPDATA')
# ----------------------------------------
excel_data_정리_전 = Watch(python_script_import_excel_by)

remember_2 = Data.Remember(excel_data_정리_전)

# group: Excel List 분할
excel_data_정리_전_2 = Watch(remember_2)
transpose = List.Transpose(lists=excel_data_정리_전_2)
code_block_3 = CodeBlock { 1; }
# note: List Name 정리
dropItems = List.DropItems(list=transpose@L2, amount=code_block_3)
watch = Watch(dropItems)
code_block_4 = CodeBlock { 0; }
getItemAtIndex = List.GetItemAtIndex(list=watch, index=code_block_4)
space_id = Watch(getItemAtIndex)
code_block_5 = CodeBlock { 1; }
getItemAtIndex_2 = List.GetItemAtIndex(list=watch, index=code_block_5)
space_name = Watch(getItemAtIndex_2)
code_block_6 = CodeBlock { 10; }
getItemAtIndex_3 = List.GetItemAtIndex(list=watch, index=code_block_6)
adjacent_spaces = Watch(getItemAtIndex_3)
code_block_7 = CodeBlock { 3; }
getItemAtIndex_4 = List.GetItemAtIndex(list=watch, index=code_block_7)
department_id = Watch(getItemAtIndex_4)
code_block_8 = CodeBlock { 2; }
getItemAtIndex_5 = List.GetItemAtIndex(list=watch, index=code_block_8)
DEPARTMENT = Watch(getItemAtIndex_5)
code_block_9 = CodeBlock { 5; }
getItemAtIndex_6 = List.GetItemAtIndex(list=watch, index=code_block_9)
WIDTH = Watch(getItemAtIndex_6)
code_block_10 = CodeBlock { 6; }
getItemAtIndex_7 = List.GetItemAtIndex(list=watch, index=code_block_10)
length = Watch(getItemAtIndex_7)
code_block_11 = CodeBlock { 7; }
getItemAtIndex_8 = List.GetItemAtIndex(list=watch, index=code_block_11)
height = Watch(getItemAtIndex_8)
code_block_12 = CodeBlock { 8; }
getItemAtIndex_9 = List.GetItemAtIndex(list=watch, index=code_block_12)
AREA = Watch(getItemAtIndex_9)
code_block_13 = CodeBlock { 14; }
getItemAtIndex_10 = List.GetItemAtIndex(list=watch, index=code_block_13)
rotate = Watch(getItemAtIndex_10)

code_block_14 = CodeBlock { 11; }
getItemAtIndex_11 = List.GetItemAtIndex(list=watch, index=code_block_14)

# group (continued): Excel List 분할
lev = Watch(getItemAtIndex_11)
code_block_15 = CodeBlock(ExcelDataWithNoHead=watch, SpaceID=space_id, SpaceName=space_name, AdjacentSpaces=adjacent_spaces, DepartmentID=department_id, Department=DEPARTMENT, Level=lev, Width=WIDTH, Length=length, Height=height, Area=AREA, Rotate=rotate)
# ---------- code_block_15.designscript (14 lines) ----------
{
"ExcelDataWithNoHead": _ExcelDataWithNoHead,
"SpaceID": _SpaceID,
"SpaceName": _SpaceName,
"AdjacentSpaces": _AdjacentSpaces,
"DepartmentID": _DepartmentID,
"Department": _Department,
"Level": _Level,
"Width": _Width,
"Length": _Length,
"Height": _Height,
"Area": _Area,
"Rotate": _Rotate
};
# ----------------------------------------

code_block_16 = CodeBlock(InputDic=code_block_15) { _InputDic; }
code_block_17 = CodeBlock { "Width"; }
valueAtKey = DesignScript.Builtin.Dictionary.ValueAtKey(dictionary=code_block_16, key=code_block_17)
code_block_18 = CodeBlock { "Length"; }
valueAtKey_2 = DesignScript.Builtin.Dictionary.ValueAtKey(dictionary=code_block_16, key=code_block_18)
code_block_19 = CodeBlock { "Height"; }
valueAtKey_3 = DesignScript.Builtin.Dictionary.ValueAtKey(dictionary=code_block_16, key=code_block_19)
byLengths = Cuboid.ByLengths(width=valueAtKey, length=valueAtKey_2, height=valueAtKey_3)
centroid = Solid.Centroid(solid=byLengths)

# group: 고정부 Seed
seed_고정부_코어 = DoubleSlider(370, range=0..999 step 1)  # graph input

# group: 변동부 Seed
seed_변형부_공간 = DoubleSlider(875, range=0..999 step 1)  # graph input

# group: 회전 Seed
seed_회전용 = DoubleSlider(251, range=0..999 step 1)  # graph input

code_block_20 = CodeBlock(FixedPartSeed=seed_고정부_코어, NonFixedPartSeed=seed_변형부_공간, RotatingSeed=seed_회전용)
# ---------- code_block_20.designscript (6 lines) ----------
{
"FixedPartSeed": _FixedPartSeed,
"NonFixedPartSeed": _NonFixedPartSeed,
"RotatingSeed": _RotatingSeed
//"BoxHeight": _BoxHeight
};
# ----------------------------------------
extendsChildDictionaryFromParent = Custom[ExtendsChildDictionaryFromParent](ParentDic=code_block, ChildDic=code_block_20)  # Extends Child Dictionary From Parent
code_block_21 = CodeBlock { "SpaceID"; }
valueAtKey_4 = DesignScript.Builtin.Dictionary.ValueAtKey(dictionary=code_block_16, key=code_block_21)
code_block_22 = CodeBlock { "SpaceName"; }
valueAtKey_5 = DesignScript.Builtin.Dictionary.ValueAtKey(dictionary=code_block_16, key=code_block_22)
code_block_23 = CodeBlock { "AdjacentSpaces"; }
valueAtKey_6 = DesignScript.Builtin.Dictionary.ValueAtKey(dictionary=code_block_16, key=code_block_23)
code_block_24 = CodeBlock { "DepartmentID"; }
valueAtKey_7 = DesignScript.Builtin.Dictionary.ValueAtKey(dictionary=code_block_16, key=code_block_24)
code_block_25 = CodeBlock { "Department"; }
valueAtKey_8 = DesignScript.Builtin.Dictionary.ValueAtKey(dictionary=code_block_16, key=code_block_25)
code_block_26 = CodeBlock { "Level"; }
valueAtKey_9 = DesignScript.Builtin.Dictionary.ValueAtKey(dictionary=code_block_16, key=code_block_26)
code_block_27 = CodeBlock { "Area"; }
valueAtKey_10 = DesignScript.Builtin.Dictionary.ValueAtKey(dictionary=code_block_16, key=code_block_27)
code_block_28 = CodeBlock { "Rotate"; }
valueAtKey_11 = DesignScript.Builtin.Dictionary.ValueAtKey(dictionary=code_block_16, key=code_block_28)
code_block_29 = CodeBlock(BoxSpaceID=valueAtKey_4, BoxSpaceName=valueAtKey_5, BoxAdjacentSpaces=valueAtKey_6, BoxDepartmentID=valueAtKey_7, BoxDepartment=valueAtKey_8, BoxLevel=valueAtKey_9, BoxWidth=valueAtKey, BoxLength=valueAtKey_2, BoxHeight=valueAtKey_3, BoxArea=valueAtKey_10, BoxRotate=valueAtKey_11)
# ---------- code_block_29.designscript (16 lines) ----------
///Box Class Primary
{
"BoxSpaceID": _BoxSpaceID,
"BoxSpaceName": _BoxSpaceName,
"BoxAdjacentSpaces": _BoxAdjacentSpaces,
"BoxDepartmentID": _BoxDepartmentID,
"BoxDepartment": _BoxDepartment,
"BoxLevel": _BoxLevel,
"BoxWidth": _BoxWidth,
"BoxLength": _BoxLength,
"BoxHeight": _BoxHeight,
"BoxArea": _BoxArea,
"BoxRotate": _BoxRotate
///"BoxGeometry": _BoxGeometry,
///"BoxCenterPoint": _BoxCenterPoint
};
# ----------------------------------------
code_block_30 = CodeBlock(BoxClass_Primary=code_block_29)
# ---------- code_block_30.designscript (3 lines) ----------
{
"BoxClass_Primary": _BoxClass_Primary
};
# ----------------------------------------
extendsChildDictionaryFromParent_2 = Custom[ExtendsChildDictionaryFromParent](ParentDic=extendsChildDictionaryFromParent.dictionary, ChildDic=code_block_30)

# group: Level에 따라 Z 값 Dictionary 추출
code_block_31 = CodeBlock(InputDic=extendsChildDictionaryFromParent_2.dictionary) { _InputDic; }
code_block_32 = CodeBlock { "BoxClass_Primary"; }
valueAtKey_12 = DesignScript.Builtin.Dictionary.ValueAtKey(dictionary=code_block_31, key=code_block_32)
code_block_33 = CodeBlock { "BoxLevel"; }
valueAtKey_13 = DesignScript.Builtin.Dictionary.ValueAtKey(dictionary=valueAtKey_12, key=code_block_33)
lev_2 = Watch(valueAtKey_13)
uniqueItems = List.UniqueItems(list=lev_2)
code_block_34 = CodeBlock { [-6000,0,6000,12000]; }
byKeysValues = DesignScript.Builtin.Dictionary.ByKeysValues(keys=uniqueItems, values=code_block_34)
watch_2 = Watch(byKeysValues)
valueAtKey_14 = DesignScript.Builtin.Dictionary.ValueAtKey(dictionary=watch_2, key=lev_2)
z_값_lev_에서_추출 = Watch(valueAtKey_14)
code_block_35 = CodeBlock(BoxZvalue=z_값_lev_에서_추출)
# ---------- code_block_35.designscript (3 lines) ----------
{
"BoxZvalue": _BoxZvalue
};
# ----------------------------------------
extendsChildDictionaryFromParent_3 = Custom[ExtendsChildDictionaryFromParent](ParentDic=valueAtKey_12, ChildDic=code_block_35)
setValueAtKeys = DesignScript.Builtin.Dictionary.SetValueAtKeys(dictionary=code_block_31, keys=code_block_32, values=extendsChildDictionaryFromParent_3.dictionary)

# group: 룸 BoundingBox 포인트 추출
code_block_36 = CodeBlock(InputDic=setValueAtKeys) { _InputDic; }
code_block_37 = CodeBlock { "RoomBoundary"; }
valueAtKey_15 = DesignScript.Builtin.Dictionary.ValueAtKey(dictionary=code_block_36, key=code_block_37)
byGeometry = BoundingBox.ByGeometry(geom=valueAtKey_15)
minPoint = BoundingBox.MinPoint(boundingBox=byGeometry)
X = Point.X(point=minPoint)
maxPoint = BoundingBox.MaxPoint(boundingBox=byGeometry)
X_2 = Point.X(point=maxPoint)
code_block_38 = CodeBlock { 500; }
code_block_39 = CodeBlock(a=X, b=X_2, x=code_block_38) { a..b..x; }
Y = Point.Y(point=minPoint)
Y_2 = Point.Y(point=maxPoint)
code_block_40 = CodeBlock { 500; }
code_block_41 = CodeBlock(a=Y, b=Y_2, x=code_block_40) { a..b..x; }
byCoordinates = Point.ByCoordinates(x=code_block_39, y=code_block_41, lacing=CrossProduct)
flatten_2 = List.Flatten(list=byCoordinates)
code_block_42 = CodeBlock(GridPointOfBoundingBox=flatten_2)
# ---------- code_block_42.designscript (3 lines) ----------
{
"GridPointOfBoundingBox": _GridPointOfBoundingBox
};
# ----------------------------------------
extendsChildDictionaryFromParent_4 = Custom[ExtendsChildDictionaryFromParent](ParentDic=code_block_36, ChildDic=code_block_42)

# group: Fixed Part 종류별 카운팅 및 Seed Random 값 부여
code_block_43 = CodeBlock(InputDic=extendsChildDictionaryFromParent_4.dictionary) { _InputDic; }
code_block_44 = CodeBlock { "BoxSeed(fixed)"; }
code_block_45 = CodeBlock { "BoxClass_Primary"; }
valueAtKey_16 = DesignScript.Builtin.Dictionary.ValueAtKey(dictionary=code_block_43, key=code_block_45)
components = DesignScript.Builtin.Dictionary.Components(dictionary=valueAtKey_16)
watch_3 = Watch(components.keys)
addItemToEnd = List.AddItemToEnd(item=code_block_44, list=watch_3)
code_block_46 = CodeBlock { "BoxDepartment"; }
valueAtKey_17 = DesignScript.Builtin.Dictionary.ValueAtKey(dictionary=valueAtKey_16, key=code_block_46)
code_block_47 = CodeBlock()
# ---------- code_block_47.designscript (6 lines) ----------
[
"PATHV1",
"PATHV2",
"PATHV3"
];
[];
# ----------------------------------------
contains = String.Contains(str=valueAtKey_17, searchFor=code_block_47.out0@@L1)
boolean = BoolSelector(true)
allIndicesOf = List.AllIndicesOf(list=contains@@L2, item=boolean)
count = List.Count(list=allIndicesOf@L3)
code_block_48 = CodeBlock { 0; }
code_block_49 = CodeBlock { "GridPointOfBoundingBox"; }
valueAtKey_18 = DesignScript.Builtin.Dictionary.ValueAtKey(dictionary=code_block_43, key=code_block_49)
count_2 = List.Count(list=valueAtKey_18)
watch_4 = Watch(count_2)
code_block_50 = CodeBlock { "FixedPartSeed"; }
valueAtKey_19 = DesignScript.Builtin.Dictionary.ValueAtKey(dictionary=code_block_43, key=code_block_50)
randomList = Math.RandomList(amount=count, value1=code_block_48, value2=watch_4, seed=valueAtKey_19)
count_3 = List.Count(list=allIndicesOf@L2)
ofRepeatedItem = List.OfRepeatedItem(item=randomList@L1, amount=count_3@L1)
flatten_3 = List.Flatten(list=ofRepeatedItem)
round = Math.Round(number=flatten_3)
transpose_2 = List.Transpose(lists=components.values)
flatten_4 = List.Flatten(list=allIndicesOf)
list_getitematindex_fixed = List.GetItemAtIndex(list=transpose_2, index=flatten_4)
addItemToEnd_2 = List.AddItemToEnd(item=round@L1, list=list_getitematindex_fixed@L2)
transpose_3 = List.Transpose(lists=addItemToEnd_2)
byKeysValues_2 = DesignScript.Builtin.Dictionary.ByKeysValues(keys=addItemToEnd, values=transpose_3)
code_block_51 = CodeBlock(BoxClass_fixedpart=byKeysValues_2)
# ---------- code_block_51.designscript (3 lines) ----------
{
"BoxClass_fixedpart": _BoxClass_fixedpart
};
# ----------------------------------------
extendsChildDictionaryFromParent_5 = Custom[ExtendsChildDictionaryFromParent](ParentDic=code_block_43, ChildDic=code_block_51)

# group: Fixed Part 형상 배치 by Seed(회전 고려)
code_block_52 = CodeBlock(InputDic=extendsChildDictionaryFromParent_5.dictionary) { _InputDic; }
code_block_53 = CodeBlock { "BoxClass_fixedpart"; }
valueAtKey_20 = DesignScript.Builtin.Dictionary.ValueAtKey(dictionary=code_block_52, key=code_block_53)
code_block_54 = CodeBlock { "BoxZvalue"; }
valueAtKey_21 = DesignScript.Builtin.Dictionary.ValueAtKey(dictionary=valueAtKey_20, key=code_block_54)
uniqueItems_2 = List.UniqueItems(list=valueAtKey_21)
code_block_55 = CodeBlock { "BoxClass_fixedpart"; }
code_block_56 = CodeBlock { "BoxGeometry"; }
components_2 = DesignScript.Builtin.Dictionary.Components(dictionary=valueAtKey_20)
addItemToEnd_3 = List.AddItemToEnd(item=code_block_56, list=components_2.keys)
code_block_57 = CodeBlock { "GridPointOfBoundingBox"; }
valueAtKey_22 = DesignScript.Builtin.Dictionary.ValueAtKey(dictionary=code_block_52, key=code_block_57)
code_block_58 = CodeBlock { "BoxSeed(fixed)"; }
valueAtKey_23 = DesignScript.Builtin.Dictionary.ValueAtKey(dictionary=valueAtKey_20, key=code_block_58)
getItemAtIndex_12 = List.GetItemAtIndex(list=valueAtKey_22, index=valueAtKey_23)
X_3 = Point.X(point=getItemAtIndex_12)
Y_3 = Point.Y(point=getItemAtIndex_12)
firstItem_2 = List.FirstItem(list=valueAtKey_21)
code_block_59 = CodeBlock(i=valueAtKey_21, j=firstItem_2) { i+Math.Abs(j/2); }
byCoordinates_2 = Point.ByCoordinates(x=X_3, y=Y_3, z=code_block_59)
code_block_60 = CodeBlock { "BoxWidth"; }
valueAtKey_24 = DesignScript.Builtin.Dictionary.ValueAtKey(dictionary=valueAtKey_20, key=code_block_60)
code_block_61 = CodeBlock { "BoxLength"; }
valueAtKey_25 = DesignScript.Builtin.Dictionary.ValueAtKey(dictionary=valueAtKey_20, key=code_block_61)
code_block_62 = CodeBlock { "BoxHeight"; }
valueAtKey_26 = DesignScript.Builtin.Dictionary.ValueAtKey(dictionary=valueAtKey_20, key=code_block_62)
byLengths_2 = Cuboid.ByLengths(origin=byCoordinates_2, width=valueAtKey_24, length=valueAtKey_25, height=valueAtKey_26)
centroid_2 = Solid.Centroid(solid=byLengths_2)
ZAxis = Vector.ZAxis()
code_block_63 = CodeBlock { "BoxClass_Primary"; }
valueAtKey_27 = DesignScript.Builtin.Dictionary.ValueAtKey(dictionary=code_block_52, key=code_block_63)
code_block_64 = CodeBlock { "BoxDepartment"; }
valueAtKey_28 = DesignScript.Builtin.Dictionary.ValueAtKey(dictionary=valueAtKey_27, key=code_block_64)
code_block_65 = CodeBlock()  # same code as code_block_47
contains_2 = String.Contains(str=valueAtKey_28, searchFor=code_block_65.out0@@L1)
boolean_2 = BoolSelector(true)
allIndicesOf_2 = List.AllIndicesOf(list=contains_2@@L2, item=boolean_2)
count_4 = List.Count(list=allIndicesOf_2)
code_block_66 = CodeBlock { 0; }
code_block_67 = CodeBlock { 90; }
code_block_68 = CodeBlock { "RotatingSeed"; }
valueAtKey_29 = DesignScript.Builtin.Dictionary.ValueAtKey(dictionary=code_block_52, key=code_block_68)
randomList_2 = Math.RandomList(amount=count_4, value1=code_block_66, value2=code_block_67, seed=valueAtKey_29)
code_block_69 = CodeBlock(i=randomList_2) { i>=45; }
code_block_70 = CodeBlock { 90; 0; }
if_ = If(test=code_block_69, true=code_block_70.out0, false=code_block_70.out1)
count_5 = List.Count(list=allIndicesOf_2@L2)
ofRepeatedItem_2 = List.OfRepeatedItem(item=if_@L1, amount=count_5@L1)
flatten_5 = List.Flatten(list=ofRepeatedItem_2)
rotate_2 = Geometry.Rotate(geometry=byLengths_2, origin=centroid_2, axis=ZAxis, degrees=flatten_5)
addItemToEnd_4 = List.AddItemToEnd(item=rotate_2, list=components_2.values)
byKeysValues_3 = DesignScript.Builtin.Dictionary.ByKeysValues(keys=addItemToEnd_3, values=addItemToEnd_4)
setValueAtKeys_2 = DesignScript.Builtin.Dictionary.SetValueAtKeys(dictionary=code_block_52, keys=code_block_55, values=byKeysValues_3)

# group: 레벨 별 고정부 비점유 포인트 추출
code_block_71 = CodeBlock(InputDic=setValueAtKeys_2) { _InputDic; }
code_block_72 = CodeBlock { "GridPointOfBoundingBox"; }
valueAtKey_30 = DesignScript.Builtin.Dictionary.ValueAtKey(dictionary=code_block_71, key=code_block_72)
X_4 = Point.X(point=valueAtKey_30)
Y_4 = Point.Y(point=valueAtKey_30)
code_block_73 = CodeBlock { "BoxClass_fixedpart"; }
valueAtKey_31 = DesignScript.Builtin.Dictionary.ValueAtKey(dictionary=code_block_71, key=code_block_73)
code_block_74 = CodeBlock { "BoxZvalue"; }
valueAtKey_32 = DesignScript.Builtin.Dictionary.ValueAtKey(dictionary=valueAtKey_31, key=code_block_74)
uniqueItems_3 = List.UniqueItems(list=valueAtKey_32)
byCoordinates_3 = Point.ByCoordinates(x=X_4, y=Y_4, z=uniqueItems_3@L1)
code_block_75 = CodeBlock { "BoxGeometry"; }
valueAtKey_33 = DesignScript.Builtin.Dictionary.ValueAtKey(dictionary=valueAtKey_31, key=code_block_75)
byUnion = Solid.ByUnion(solids=valueAtKey_33)
doesIntersect = Geometry.DoesIntersect(geometry=byCoordinates_3, other=byUnion)
filterByBoolMask = List.FilterByBoolMask(list=byCoordinates_3@L2, mask=doesIntersect@L2)
watch_5 = Watch(filterByBoolMask.out)
code_block_76 = CodeBlock(RestGridPointByLevel=watch_5)
# ---------- code_block_76.designscript (3 lines) ----------
{
"RestGridPointByLevel": _RestGridPointByLevel
};
# ----------------------------------------
extendsChildDictionaryFromParent_6 = Custom[ExtendsChildDictionaryFromParent](ParentDic=code_block_71, ChildDic=code_block_76)

code_block_77 = CodeBlock(i=extendsChildDictionaryFromParent_6.dictionary) { i; }

# group: Non-Fixed Part 종류별 카운팅
code_block_78 = CodeBlock(InputDic=code_block_77) { _InputDic; }
code_block_79 = CodeBlock { "BoxClass_Primary"; }
valueAtKey_34 = DesignScript.Builtin.Dictionary.ValueAtKey(dictionary=code_block_78, key=code_block_79)
components_3 = DesignScript.Builtin.Dictionary.Components(dictionary=valueAtKey_34)
transpose_4 = List.Transpose(lists=components_3.values)
code_block_80 = CodeBlock { "BoxSpaceID"; }
valueAtKey_35 = DesignScript.Builtin.Dictionary.ValueAtKey(dictionary=valueAtKey_34, key=code_block_80)
code_block_81 = CodeBlock { "BoxClass_fixedpart"; }
valueAtKey_36 = DesignScript.Builtin.Dictionary.ValueAtKey(dictionary=code_block_78, key=code_block_81)
code_block_82 = CodeBlock { "BoxSpaceID"; }
valueAtKey_37 = DesignScript.Builtin.Dictionary.ValueAtKey(dictionary=valueAtKey_36, key=code_block_82)
setDifference = List.SetDifference(list1=valueAtKey_35, list2=valueAtKey_37)
getItemAtIndex_13 = List.GetItemAtIndex(list=transpose_4, index=setDifference)
transpose_5 = List.Transpose(lists=getItemAtIndex_13)
byKeysValues_4 = DesignScript.Builtin.Dictionary.ByKeysValues(keys=components_3.keys, values=transpose_5)
code_block_83 = CodeBlock(BoxClass_nonfixedpart=byKeysValues_4)
# ---------- code_block_83.designscript (3 lines) ----------
{
"BoxClass_nonfixedpart": _BoxClass_nonfixedpart
};
# ----------------------------------------
extendsChildDictionaryFromParent_7 = Custom[ExtendsChildDictionaryFromParent](ParentDic=code_block_78, ChildDic=code_block_83)

# group: Non-Fixed Part 레벨 별 Seed Random 값 부여
code_block_84 = CodeBlock(InputDic=extendsChildDictionaryFromParent_7.dictionary) { _InputDic; }
code_block_85 = CodeBlock { "BoxClass_nonfixedpart"; }
code_block_86 = CodeBlock { "BoxSeed(nonfixed)"; }
code_block_87 = CodeBlock { "BoxClass_nonfixedpart"; }
valueAtKey_38 = DesignScript.Builtin.Dictionary.ValueAtKey(dictionary=code_block_84, key=code_block_87)
components_4 = DesignScript.Builtin.Dictionary.Components(dictionary=valueAtKey_38)
addItemToEnd_5 = List.AddItemToEnd(item=code_block_86, list=components_4.keys)
code_block_88 = CodeBlock { "BoxClass_nonfixedpart"; }
valueAtKey_39 = DesignScript.Builtin.Dictionary.ValueAtKey(dictionary=code_block_84, key=code_block_88)
code_block_89 = CodeBlock { "BoxLevel"; }
valueAtKey_40 = DesignScript.Builtin.Dictionary.ValueAtKey(dictionary=valueAtKey_39, key=code_block_89)
uniqueItems_4 = List.UniqueItems(list=valueAtKey_40)
allIndicesOf_3 = List.AllIndicesOf(list=valueAtKey_40, item=uniqueItems_4)
count_6 = List.Count(list=allIndicesOf_3@L2)
code_block_90 = CodeBlock { 0; }
code_block_91 = CodeBlock { "RestGridPointByLevel"; }
valueAtKey_41 = DesignScript.Builtin.Dictionary.ValueAtKey(dictionary=code_block_84, key=code_block_91)
count_7 = List.Count(list=valueAtKey_41@L2)
count_8 = List.Count(list=allIndicesOf_3@L3)
code_block_92 = CodeBlock { 0; 999; }
code_block_93 = CodeBlock { "NonFixedPartSeed"; }
valueAtKey_42 = DesignScript.Builtin.Dictionary.ValueAtKey(dictionary=code_block_84, key=code_block_93)
randomList_3 = Math.RandomList(amount=count_8, value1=code_block_92.out0, value2=code_block_92.out1, seed=valueAtKey_42)
flatten_6 = List.Flatten(list=randomList_3)
randomList_4 = Math.RandomList(amount=count_6, value1=code_block_90, value2=count_7, seed=flatten_6)
flatten_7 = List.Flatten(list=randomList_4)
round_2 = Math.Round(number=flatten_7)
components_5 = DesignScript.Builtin.Dictionary.Components(dictionary=valueAtKey_39)
transpose_6 = List.Transpose(lists=components_5.values)
getItemAtIndex_14 = List.GetItemAtIndex(list=transpose_6, index=allIndicesOf_3)
flatten_8 = List.Flatten(list=getItemAtIndex_14@L2)
addItemToEnd_6 = List.AddItemToEnd(item=round_2@L1, list=flatten_8@L2)
transpose_7 = List.Transpose(lists=addItemToEnd_6)
byKeysValues_5 = DesignScript.Builtin.Dictionary.ByKeysValues(keys=addItemToEnd_5, values=transpose_7)
setValueAtKeys_3 = DesignScript.Builtin.Dictionary.SetValueAtKeys(dictionary=code_block_84, keys=code_block_85, values=byKeysValues_5)

# group: Non-Fixed Part 형상 배치 by Seed(회전 고려)
code_block_94 = CodeBlock(InputDic=setValueAtKeys_3) { _InputDic; }
code_block_95 = CodeBlock { "BoxClass_fixedpart"; }
code_block_96 = CodeBlock { "BoxGeometry"; }
code_block_97 = CodeBlock { "BoxClass_nonfixedpart"; }
valueAtKey_43 = DesignScript.Builtin.Dictionary.ValueAtKey(dictionary=code_block_94, key=code_block_97)
components_6 = DesignScript.Builtin.Dictionary.Components(dictionary=valueAtKey_43)
addItemToEnd_7 = List.AddItemToEnd(item=code_block_96, list=components_6.keys)
code_block_98 = CodeBlock { "RestGridPointByLevel"; }
valueAtKey_44 = DesignScript.Builtin.Dictionary.ValueAtKey(dictionary=code_block_94, key=code_block_98)
code_block_99 = CodeBlock { "BoxSeed(nonfixed)"; }
valueAtKey_45 = DesignScript.Builtin.Dictionary.ValueAtKey(dictionary=valueAtKey_43, key=code_block_99)
code_block_100 = CodeBlock { "BoxLevel"; }
valueAtKey_46 = DesignScript.Builtin.Dictionary.ValueAtKey(dictionary=valueAtKey_43, key=code_block_100)
uniqueItems_5 = List.UniqueItems(list=valueAtKey_46)
allIndicesOf_4 = List.AllIndicesOf(list=valueAtKey_46, item=uniqueItems_5)
count_9 = List.Count(list=allIndicesOf_4@L2)
chop = List.Chop(list=valueAtKey_45, lengths=count_9)
getItemAtIndex_15 = List.GetItemAtIndex(list=valueAtKey_44@L2, index=chop@L2)
X_5 = Point.X(point=getItemAtIndex_15)
flatten_9 = List.Flatten(list=X_5)
Y_5 = Point.Y(point=getItemAtIndex_15)
flatten_10 = List.Flatten(list=Y_5)
code_block_101 = CodeBlock { "BoxZvalue"; }
valueAtKey_47 = DesignScript.Builtin.Dictionary.ValueAtKey(dictionary=valueAtKey_43, key=code_block_101)
firstItem_3 = List.FirstItem(list=valueAtKey_47)
code_block_102 = CodeBlock(i=valueAtKey_47, j=firstItem_3) { i+Math.Abs(j/2); }
byCoordinates_4 = Point.ByCoordinates(x=flatten_9, y=flatten_10, z=code_block_102)
flatten_11 = List.Flatten(list=byCoordinates_4)
code_block_103 = CodeBlock { "BoxWidth"; }
valueAtKey_48 = DesignScript.Builtin.Dictionary.ValueAtKey(dictionary=valueAtKey_43, key=code_block_103)
code_block_104 = CodeBlock { "BoxLength"; }
valueAtKey_49 = DesignScript.Builtin.Dictionary.ValueAtKey(dictionary=valueAtKey_43, key=code_block_104)
code_block_105 = CodeBlock { "BoxHeight"; }
valueAtKey_50 = DesignScript.Builtin.Dictionary.ValueAtKey(dictionary=valueAtKey_43, key=code_block_105)
byLengths_3 = Cuboid.ByLengths(origin=flatten_11, width=valueAtKey_48, length=valueAtKey_49, height=valueAtKey_50)
centroid_3 = Solid.Centroid(solid=byLengths_3)
ZAxis_2 = Vector.ZAxis()
code_block_106 = CodeBlock { "BoxSpaceName"; }
valueAtKey_51 = DesignScript.Builtin.Dictionary.ValueAtKey(dictionary=valueAtKey_43, key=code_block_106)
count_10 = List.Count(list=valueAtKey_51)
code_block_107 = CodeBlock { 0; }
code_block_108 = CodeBlock { 90; }
code_block_109 = CodeBlock { "RotatingSeed"; }
valueAtKey_52 = DesignScript.Builtin.Dictionary.ValueAtKey(dictionary=code_block_94, key=code_block_109)
randomList_5 = Math.RandomList(amount=count_10, value1=code_block_107, value2=code_block_108, seed=valueAtKey_52)
code_block_110 = CodeBlock(i=randomList_5) { i>=45; }
code_block_111 = CodeBlock { 90; 0; }

watch_6 = Watch(code_block_110)
code_block_112 = CodeBlock { "BoxClass_nonfixedpart"; }
valueAtKey_53 = DesignScript.Builtin.Dictionary.ValueAtKey(dictionary=code_block_94, key=code_block_112)
code_block_113 = CodeBlock { "BoxRotate"; }
valueAtKey_54 = DesignScript.Builtin.Dictionary.ValueAtKey(dictionary=valueAtKey_53, key=code_block_113)
watch_7 = Watch(valueAtKey_54)
code_block_114 = CodeBlock { 1; }
allIndicesOf_5 = List.AllIndicesOf(list=watch_7, item=code_block_114)
watch_8 = Watch(byLengths_3)
explode = Geometry.Explode(geometry=watch_8)
watch_9 = Watch(explode)
code_block_115 = CodeBlock { 0.5; }
normalAtParameter = Surface.NormalAtParameter(surface=watch_9, u=code_block_115, v=code_block_115)
watch_10 = Watch(normalAtParameter)
Z = Vector.Z(vector=watch_10)
code_block_116 = CodeBlock { -1; }
eq = Z == code_block_116
filterByBoolMask_2 = List.FilterByBoolMask(list=watch_9, mask=eq)
flatten_12 = List.Flatten(list=filterByBoolMask_2.in)
code_block_117 = CodeBlock { 0; 1; 0.5; }
pointAtParameter = Surface.PointAtParameter(surface=flatten_12, u=code_block_117.out1, v=code_block_117.out2)
pointAtParameter_2 = Surface.PointAtParameter(surface=flatten_12, u=code_block_117.out0, v=code_block_117.out2)
byStartPointEndPoint = Line.ByStartPointEndPoint(startPoint=pointAtParameter, endPoint=pointAtParameter_2)
length_2 = Curve.Length(curve=byStartPointEndPoint)
pointAtParameter_3 = Surface.PointAtParameter(surface=flatten_12, u=code_block_117.out2, v=code_block_117.out1)
pointAtParameter_4 = Surface.PointAtParameter(surface=flatten_12, u=code_block_117.out2, v=code_block_117.out0)
byStartPointEndPoint_2 = Line.ByStartPointEndPoint(startPoint=pointAtParameter_3, endPoint=pointAtParameter_4)
length_3 = Curve.Length(curve=byStartPointEndPoint_2)
gt = length_2 > length_3
if_2 = If(test=gt, true=byStartPointEndPoint, false=byStartPointEndPoint_2)
direction = Line.Direction(line=if_2)
watch_11 = Watch(direction)
normalized = Vector.Normalized(vector=watch_11)
watch_12 = Watch(normalized)
watch_13 = Watch(byJoinedCurves)

# group: 대지 장변 찾기
watch_14 = Watch(watch_13)
byPatch = Surface.ByPatch(closedCurve=watch_14)
code_block_118 = CodeBlock { 0; 1; 0.5; }
pointAtParameter_5 = Surface.PointAtParameter(surface=byPatch, u=code_block_118.out1, v=code_block_118.out2)
pointAtParameter_6 = Surface.PointAtParameter(surface=byPatch, u=code_block_118.out0, v=code_block_118.out2)
byStartPointEndPoint_3 = Line.ByStartPointEndPoint(startPoint=pointAtParameter_5, endPoint=pointAtParameter_6)
pointAtParameter_7 = Surface.PointAtParameter(surface=byPatch, u=code_block_118.out2, v=code_block_118.out1)
pointAtParameter_8 = Surface.PointAtParameter(surface=byPatch, u=code_block_118.out2, v=code_block_118.out0)
byStartPointEndPoint_4 = Line.ByStartPointEndPoint(startPoint=pointAtParameter_7, endPoint=pointAtParameter_8)

length_4 = Curve.Length(curve=byStartPointEndPoint_3)
length_5 = Curve.Length(curve=byStartPointEndPoint_4)
gt_2 = length_4 > length_5
direction_2 = Line.Direction(line=byStartPointEndPoint_3)
watch_15 = Watch(direction_2)
normalized_2 = Vector.Normalized(vector=watch_15)
watch_16 = Watch(normalized_2)
direction_3 = Line.Direction(line=byStartPointEndPoint_4)
watch_17 = Watch(direction_3)
normalized_3 = Vector.Normalized(vector=watch_17)
watch_18 = Watch(normalized_3)
if_3 = If(test=gt_2, true=watch_16, false=watch_18)
watch_19 = Watch(if_3)
isParallel = Vector.IsParallel(vector=watch_12, other=watch_19, lacing=Longest)
watch_20 = Watch(isParallel)
watch_21 = Watch(watch_20)
getItemAtIndex_16 = List.GetItemAtIndex(list=watch_21, index=allIndicesOf_5)
replaceItemAtIndex = Custom[List.ReplaceItemAtIndex+](seq=watch_6, indices=allIndicesOf_5, replacement=getItemAtIndex_16)  # package Clockwork for Dynamo 2.x; Replaces the item at a given index of a list by another item. Unlike the OOTB node, it can replace items at multiple indeces.

# group (continued): Non-Fixed Part 형상 배치 by Seed(회전 고려)
if_4 = If(test=replaceItemAtIndex, true=code_block_111.out1, false=code_block_111.out0)
flatten_13 = List.Flatten(list=if_4)
rotate_3 = Geometry.Rotate(geometry=byLengths_3, origin=centroid_3, axis=ZAxis_2, degrees=flatten_13)
addItemToEnd_8 = List.AddItemToEnd(item=rotate_3, list=components_6.values)
byKeysValues_6 = DesignScript.Builtin.Dictionary.ByKeysValues(keys=addItemToEnd_7, values=addItemToEnd_8)
setValueAtKeys_4 = DesignScript.Builtin.Dictionary.SetValueAtKeys(dictionary=code_block_94, keys=code_block_95, values=byKeysValues_6)

color_palette = ColorPalette({R: 255, G: 20, B: 147, A: 255})
byGeometryColor = Modifiers.GeometryColor.ByGeometryColor(geometry=rotate_2, color=color_palette)
color_palette_2 = ColorPalette({R: 0, G: 255, B: 255, A: 120})
byGeometryColor_2 = Modifiers.GeometryColor.ByGeometryColor(geometry=rotate_3, color=color_palette_2)
watch_22 = Watch(watch_13)
byPatch_2 = Surface.ByPatch(closedCurve=watch_22)
code_block_119 = CodeBlock { 50000; }
thicken = Surface.Thicken(surface=byPatch_2, thickness=code_block_119)
color_palette_3 = ColorPalette({R: 0, G: 250, B: 154, A: 255})
byGeometryColor_3 = Modifiers.GeometryColor.ByGeometryColor(geometry=thicken, color=color_palette_3)
byARGB = Color.ByARGB()

# group: 각층의 Rooms Union Center point
watch_23 = Watch(rotate_3)
centroid_4 = Solid.Centroid(solid=watch_23)
Z_2 = Point.Z(point=centroid_4)
watch_24 = Watch(Z_2)
string_from_object_2 = FromObject(object=watch_24)
uniqueItems_6 = List.UniqueItems(list=string_from_object_2)
eq_2 = uniqueItems_6 == string_from_object_2  # lacing=CrossProduct
filterByBoolMask_3 = List.FilterByBoolMask(list=watch_23, mask=eq_2@L2)
watch_25 = Watch(filterByBoolMask_3.in)
byUnion_2 = Solid.ByUnion(solids=watch_25)
centroid_5 = Solid.Centroid(solid=byUnion_2)
boundingBox = Geometry.BoundingBox(geometry=byUnion_2)

# group: func2
explode_2 = Geometry.Explode(geometry=watch_25)
code_block_120 = CodeBlock { 0.5; }
normalAtParameter_2 = Surface.NormalAtParameter(surface=explode_2, u=code_block_120, v=code_block_120)
Z_3 = Vector.Z(vector=normalAtParameter_2)
code_block_121 = CodeBlock(i=Z_3) { i==-1; }
filterByBoolMask_4 = List.FilterByBoolMask(list=explode_2, mask=code_block_121)
code_block_122 = CodeBlock { 1; }
flatten_14 = List.Flatten(list=filterByBoolMask_4.in@L3, amt=code_block_122)
code_block_123 = CodeBlock { 0.5; }
pointAtParameter_9 = Surface.PointAtParameter(surface=flatten_14, u=code_block_123, v=code_block_123)
Z_4 = Point.Z(point=pointAtParameter_9)
flatten_15 = List.Flatten(list=Z_4)
uniqueItems_7 = List.UniqueItems(list=flatten_15)

# group: 각층의 중심점
watch_26 = Watch(watch_13)
byPatch_3 = Surface.ByPatch(closedCurve=watch_26)
translate = Geometry.Translate(geometry=byPatch_3, zTranslation=uniqueItems_7, lacing=Longest)
code_block_124 = CodeBlock { 0.5; }
pointAtParameter_10 = Surface.PointAtParameter(surface=translate, u=code_block_124, v=code_block_124)
toNumber = String.ToNumber(str=uniqueItems_6)

byStartPointEndPoint_5 = Line.ByStartPointEndPoint(startPoint=centroid_5, endPoint=pointAtParameter_10)
direction_4 = Line.Direction(line=byStartPointEndPoint_5)
translate_2 = Geometry.Translate(geometry=watch_25, direction=direction_4)
flatten_16 = List.Flatten(list=translate_2)
watch_27 = Watch(flatten_16)
byUnion_3 = Solid.ByUnion(solids=watch_27)
differenceAll = Solid.DifferenceAll(solid=byUnion_3, others=thicken)
volume = Solid.Volume(solid=differenceAll)  # graph output

# group: 0~10 정배열 List Point 변경
X_6 = Point.X()  # unwired: point
Y_6 = Point.Y()  # unwired: point
z_값_lev_에서_추출_2 = Watch()  # unwired: arg0
byCoordinates_5 = Point.ByCoordinates(x=X_6, y=Y_6, z=z_값_lev_에서_추출_2)
정배열_points = Watch(byCoordinates_5)

# group: ADJACENT SPACES 연결을 위한 List 정리 / Line 추출
정배열_points_2 = Watch(flatten_11)
space_id_2 = Watch(space_id)
getItemAtIndex_17 = List.GetItemAtIndex(list=정배열_points_2, index=space_id_2)
adjacent_spaces_2 = Watch(adjacent_spaces)
string_from_object_3 = FromObject(object=adjacent_spaces_2)
watch_28 = Watch(string_from_object_3)
code_block_125 = CodeBlock { ","; }
split = String.Split(str=watch_28@L1, separator0=code_block_125)
toNumber_2 = String.ToNumber(str=split)
flatten_17 = List.Flatten(list=toNumber_2)
string_from_object_4 = FromObject(object=flatten_17)
code_block_126 = CodeBlock { 1; }
code_block_127 = CodeBlock { 2; }
remove = String.Remove(string=string_from_object_4, startIndex=code_block_126, count=code_block_127)
watch_29 = Watch(remove)
isNull = Object.IsNull(object=watch_29)
boolean_3 = BoolSelector(false)
allIndicesOf_6 = List.AllIndicesOf(list=isNull, item=boolean_3)
watch_30 = Watch(allIndicesOf_6)
getItemAtIndex_18 = List.GetItemAtIndex(list=watch_29, index=watch_30)
replaceItemAtIndex_2 = Custom[List.ReplaceItemAtIndex+](seq=string_from_object_4, indices=watch_30, replacement=getItemAtIndex_18)
toNumber_3 = String.ToNumber(str=replaceItemAtIndex_2)
adjacent_spaces_flatten = Watch(toNumber_3)
getItemAtIndex_19 = List.GetItemAtIndex(list=정배열_points_2, index=adjacent_spaces_flatten)
count_11 = List.Count(list=toNumber_2@L2)
chop_2 = List.Chop(list=getItemAtIndex_19, lengths=count_11)
byStartPointEndPoint_6 = Line.ByStartPointEndPoint(startPoint=getItemAtIndex_17, endPoint=chop_2, lacing=Shortest)

flatten_18 = List.Flatten(list=byStartPointEndPoint_6)
length_6 = Curve.Length(curve=flatten_18)
sum = Math.Sum(values=length_6)
separate = Solid.Separate()  # unwired: solid
color_palette_4 = ColorPalette({R: 0, G: 255, B: 255, A: 120})
byGeometryColor_4 = Modifiers.GeometryColor.ByGeometryColor(geometry=translate_2, color=color_palette_4)
direction_5 = Line.Direction(line=byStartPointEndPoint)
watch_31 = Watch(direction_5)
normalized_4 = Vector.Normalized(vector=watch_31)
watch_32 = Watch(normalized_4)
direction_6 = Line.Direction(line=byStartPointEndPoint_2)
watch_33 = Watch(direction_6)
normalized_5 = Vector.Normalized(vector=watch_33)
watch_34 = Watch(normalized_5)
code_block_128 = CodeBlock {  }
code_block_129 = CodeBlock {  }
pointAtParameter_11 = Surface.PointAtParameter(surface=watch_9, v=code_block_115)
watch_35 = Watch(flatten_14)
code_block_130 = CodeBlock(a=watch_35) { a[3]; }
code_block_131 = CodeBlock { 0.2..0.8..0.1; 0..1.5..0.1; }
pointAtParameter_12 = Surface.PointAtParameter(surface=translate, u=code_block_131.out1, v=code_block_131.out1, lacing=CrossProduct)
flatten_19 = List.Flatten(list=pointAtParameter_12)
count_12 = List.Count(list=pointAtParameter_12@L2)
sum_2 = Math.Sum(values=count_12)
code_block_132 = CodeBlock(a=sum_2) { a/4; }
chop_3 = List.Chop(list=flatten_19, lengths=code_block_132)
code_block_133 = CodeBlock(a=chop_3) { a[3]; }
code_block_134 = CodeBlock(surfaces=code_block_130, points=code_block_133) { surfaces; points; }
number_slider = DoubleSlider(4, range=0..100 step 1)
python_script = Python(IN[0]=code_block_134.surfaces, IN[1]=code_block_134.points, IN[2]=number_slider)  # IronPython2
# ---------- python_script.python (48 lines) ----------
# Python 표준 및 DesignScript 라이브러리 로드
import random
import sys
import clr
clr.AddReference('ProtoGeometry')
from Autodesk.DesignScript.Geometry import *

# 이 노드에 대한 입력값은 IN 변수에 리스트로 저장됩니다.
dataEnteringNode = IN


surfaces = IN[0]
points = IN[1]
checks = [False for i in range(len(points))]

random.seed(a=None)

n = len(surfaces)
cnt = 0

result = []

while cnt < n:
    r = random.randint(0, len(points) - 1)

    test = Geometry.Translate(surfaces[cnt], points[r].X, points[r].Y, 0)

    validCheck = True

    for i in range(0, len(points) - 1):
        if test.Intersect(points[i]) and checks[i] == True:
            validCheck = False
            break

    if validCheck == True:
        for i in range(0, len(points) - 1):
            if test.Intersect(points[i]):
                checks[i] = True
        cnt = cnt + 1
        result.append(test)
        



# 코드를 이 선 아래에 배치

# 출력을 OUT 변수에 지정합니다.
OUT = result
# ----------------------------------------
number = DoubleInput(0)
python_script_2 = Python(IN[0]=code_block_134.surfaces, IN[1]=number)  # IronPython2
# ---------- python_script_2.python (264 lines) ----------
# Python 표준 및 DesignScript 라이브러리 로드
from random import randint
import sys
import clr
clr.AddReference('ProtoGeometry')
clr.AddReference('DSCoreNodes')
from DSCore import *
from Autodesk.DesignScript.Geometry import *



def GetXOrderSurfaces(sl):
    ls = []
    for s in sl:
        ls.append(SortByMinX(s))

    ls.sort()

    r = []
    for l in ls:
        r.append(l.val)

    return r

def GetYOrderSurfaces(sl):
    ls = []
    for s in sl:
        ls.append(SortByMinY(s))

    ls.sort()

    r = []
    for l in ls:
        r.append(l.val)

    return r

def GetIndexOfSurface(s, sl):
    for i in range(0, len(sl)):
        if sl[i] == s:
            return i

def GetSurfaceMinX(s):
    a1 = Math.Min(s.PointAtParameter(0,0).X, s.PointAtParameter(0,1).X)
    a2 = Math.Min(s.PointAtParameter(1,0).X, s.PointAtParameter(1,1).X)
    return Math.Min(a1, a2)

def GetSurfaceMaxX(s):
    a1 = Math.Max(s.PointAtParameter(0,0).X, s.PointAtParameter(0,1).X)
    a2 = Math.Max(s.PointAtParameter(1,0).X, s.PointAtParameter(1,1).X)
    return Math.Max(a1, a2)

def GetSurfaceMinY(s):
    a1 = Math.Min(s.PointAtParameter(0,0).Y, s.PointAtParameter(0,1).Y)
    a2 = Math.Min(s.PointAtParameter(1,0).Y, s.PointAtParameter(1,1).Y)
    return Math.Min(a1, a2)

def GetSurfaceMaxY(s):
    a1 = Math.Max(s.PointAtParameter(0,0).Y, s.PointAtParameter(0,1).Y)
    a2 = Math.Max(s.PointAtParameter(1,0).Y, s.PointAtParameter(1,1).Y)
    return Math.Max(a1, a2)


class SortByMinX(object):
     def __init__(self, val):
         self.val = val

     def __lt__(self, other):
         return GetSurfaceMinX(self.val) < GetSurfaceMinX(other.val)

class SortByMinY(object):
     def __init__(self, val):
         self.val = val

     def __lt__(self, other):
         return GetSurfaceMinY(self.val) < GetSurfaceMinY(other.val)


def CreateXCheckerSurface(s):
    minX = GetSurfaceMinX(s)
    minY = GetSurfaceMinY(s)
    maxX = GetSurfaceMaxX(s)
    maxY = GetSurfaceMaxY(s)
    minZ = s.PointAtParameter(0,0).Z
    pl = [
            Point.ByCoordinates(minX - 100000, minY + 0.1, minZ),
            Point.ByCoordinates(minX - 100000, maxY - 0.1, minZ),
            Point.ByCoordinates(minX, maxY - 0.1, minZ),
            Point.ByCoordinates(minX, minY + 0.1, minZ),
        ]

    checkerX = Surface.ByPerimeterPoints(pl)

    return checkerX

def CreateYCheckerSurface(s):
    minX = GetSurfaceMinX(s)
    minY = GetSurfaceMinY(s)
    maxX = GetSurfaceMaxX(s)
    maxY = GetSurfaceMaxY(s)
    minZ = s.PointAtParameter(0,0).Z
    pl = [
            Point.ByCoordinates(minX + 0.1, minY - 100000, minZ),
            Point.ByCoordinates(minX + 0.1, minY, minZ),
            Point.ByCoordinates(maxX - 0.1, minY, minZ),
            Point.ByCoordinates(maxX - 0.1, minY - 100000, minZ),
        ]

    checkerX = Surface.ByPerimeterPoints(pl)

    return checkerX

def GetDistanceXToMove(s, sl):
    checkerX = CreateXCheckerSurface(s)

    cl = []

    noHit = True

    for si in sl:
        if si == s:
            continue
        else:
            if checkerX.DoesIntersect(si) == True:
                noHit = False

                cl.append(si.PointAtParameter(0,0).X)
                cl.append(si.PointAtParameter(0,1).X)
                cl.append(si.PointAtParameter(1,0).X)
                cl.append(si.PointAtParameter(1,1).X)

    if noHit == True:
        return - GetSurfaceMinX(s)
    else:
        cl.sort(reverse=True)
        return cl[0] - GetSurfaceMinX(s)

def GetDistanceYToMove(s, sl):
    checkerY = CreateYCheckerSurface(s)

    cl = []

    noHit = True

    for si in sl:
        if si == s:
            continue
        else:
            if checkerY.DoesIntersect(si) == True:
                noHit = False

                cl.append(si.PointAtParameter(0,0).Y)
                cl.append(si.PointAtParameter(0,1).Y)
                cl.append(si.PointAtParameter(1,0).Y)
                cl.append(si.PointAtParameter(1,1).Y)

    if noHit == True:
        return - GetSurfaceMinY(s)
    else:
        cl.sort(reverse=True)
        return cl[0] - GetSurfaceMinY(s)


def MoveX():
    xOrdered = GetXOrderSurfaces(surfacelist)

    for s in xOrdered:    
        toMoveX = GetDistanceXToMove(s, surfacelist)
        idx = GetIndexOfSurface(s, surfacelist)
        surfacelist[idx] = Geometry.Translate(surfacelist[idx], toMoveX, 0, 0)

def MoveY():
    yOrdered = GetYOrderSurfaces(surfacelist)

    for s in yOrdered:
        toMoveY = GetDistanceYToMove(s, surfacelist)
        idx = GetIndexOfSurface(s, surfacelist)
        surfacelist[idx] = Geometry.Translate(surfacelist[idx], 0, toMoveY, 0)

def SplitX():
    xOrdered = GetXOrderSurfaces(surfacelist)

    offsetX = 0   
    for i in range(0, len(xOrdered)):
        idx = GetIndexOfSurface(xOrdered[i], surfacelist)

        mx = offsetX - GetSurfaceMinX(surfacelist[idx])
        surfacelist[idx] = Geometry.Translate(surfacelist[idx], mx, 0, 0)

        sx = GetSurfaceMaxX(surfacelist[idx]) - GetSurfaceMinX(surfacelist[idx])
        offsetX = offsetX + sx

def SplitY():
    yOrdered = GetYOrderSurfaces(surfacelist)

    offsetY = 0   
    for i in range(0, len(yOrdered)):
        idx = GetIndexOfSurface(yOrdered[i], surfacelist)

        my = offsetY - GetSurfaceMinY(surfacelist[idx])
        surfacelist[idx] = Geometry.Translate(surfacelist[idx], 0, my, 0)

        sy = GetSurfaceMaxY(surfacelist[idx]) - GetSurfaceMinY(surfacelist[idx])
        offsetY = offsetY + sy

def MinofAll():
    allX = []
    allY = []
    for s in surfacelist:
        allX.append(GetSurfaceMinX(s))
        allY.append(GetSurfaceMinY(s))
    allX.sort()
    allY.sort()
    x = 0
    if allX[0] < 0:
        x = -allX[0]
    y = 0
    if allY[0] < 0:
        y = -allY[0]

    return x,y



# 이 노드에 대한 입력값은 IN 변수에 리스트로 저장됩니다.
dataEnteringNode = IN

# 코드를 이 선 아래에 배치

surfaces = IN[0]

surfacelist = []
for s in surfaces:
    surfacelist.append(s)

(basX, basY) = MinofAll()
for i in range(0, len(surfacelist)):
    surfacelist[i] = Geometry.Translate(surfacelist[i], basX, basY, 0)

if randint(0, 1) == 0:
    SplitX()
    MoveX()
    MoveY()
    MoveX()
    MoveY()
else:
    SplitY()
    MoveY()
    MoveX()
    MoveY()
    MoveX()

# testnum = IN[1]
# xOrdered = GetXOrderSurfaces(surfacelist)

# # for s in xOrdered:    
# toMoveX = GetDistanceXToMove(xOrdered[testnum], surfacelist)
# idx = GetIndexOfSurface(xOrdered[testnum], surfacelist)
# surfacelist[idx] = Geometry.Translate(surfacelist[idx], toMoveX, 0, 0)



# 출력을 OUT 변수에 지정합니다.
OUT = surfacelist
# ----------------------------------------
code_block_135 = CodeBlock {  }
code_block_136 = CodeBlock {  }
color_palette_5 = ColorPalette({R: 0, G: 255, B: 0, A: 106})
byGeometryColor_5 = Modifiers.GeometryColor.ByGeometryColor(color=color_palette_5)  # unwired: geometry
code_block_137 = CodeBlock {  }
code_block_138 = CodeBlock {  }
translate_3 = Geometry.Translate(geometry=code_block_133)
translate_4 = Geometry.Translate(geometry=code_block_134.surfaces)
code_block_139 = CodeBlock { t1 = 0; num1 = Math.Min(t1, t1); num2 = Math.Abs(num1); }
# note: Surfaces
list_create = List.Create()  # unwired: item0, item1, item2
byJoinedSurfaces = PolySurface.ByJoinedSurfaces(surfaces=list_create)
code_block_140 = CodeBlock { 0.5; }
pointAtParameter_13 = Surface.PointAtParameter(surface=byJoinedSurfaces@L2, u=code_block_140, v=code_block_140)
perimeterCurves = Surface.PerimeterCurves(surface=byJoinedSurfaces)
flatten_20 = List.Flatten(list=perimeterCurves)
code_block_141 = CodeBlock { corepoint; }  # unwired: corepoint
# note: Center point
join = List.Join()  # unwired: list0, list1, list2
byStartPointEndPoint_7 = Line.ByStartPointEndPoint(startPoint=code_block_141, endPoint=join)
doesIntersect_2 = Geometry.DoesIntersect(geometry=byStartPointEndPoint_7, other=flatten_20, lacing=CrossProduct)
filterByBoolMask_5 = List.FilterByBoolMask(list=flatten_20, mask=doesIntersect_2@L2)
flatten_21 = List.Flatten(list=filterByBoolMask_5.in)
code_block_142 = CodeBlock { 2; }
offset = Curve.Offset(curve=flatten_21, distance=code_block_142)
list_create_2 = List.Create(item0=flatten_21, item1=offset)
transpose_8 = List.Transpose(lists=list_create_2)
byLoft = Surface.ByLoft(crossSections=transpose_8)
list_create_3 = List.Create(item0=byJoinedSurfaces, item1=byLoft)
transpose_9 = List.Transpose(lists=list_create_3)
byJoinedSurfaces_2 = PolySurface.ByJoinedSurfaces(surfaces=transpose_9)
perimeterCurves_2 = Surface.PerimeterCurves(surface=byJoinedSurfaces_2)
code_block_143 = CodeBlock { -1; }
dropItems_2 = List.DropItems(list=watch_35, amount=code_block_143)
code_block_144 = CodeBlock { 5; }
chop_4 = List.Chop(list=code_block_130, lengths=code_block_144)
join_2 = List.Join(list0=dropItems_2, list1=chop_4)
python_script_3 = Python(IN[0]=join_2)  # IronPython2
# ---------- python_script_3.python (276 lines) ----------
# Python 표준 및 DesignScript 라이브러리 로드
from random import randint
import sys
import clr
import copy
clr.AddReference('ProtoGeometry')
clr.AddReference('DSCoreNodes')
from DSCore import *
from Autodesk.DesignScript.Geometry import *



def GetXOrderSurfaces(sl):
    ls = []
    for s in sl:
        ls.append(SortByMinX(s))

    ls.sort()

    r = []
    for l in ls:
        r.append(l.val)

    return r

def GetYOrderSurfaces(sl):
    ls = []
    for s in sl:
        ls.append(SortByMinY(s))

    ls.sort()

    r = []
    for l in ls:
        r.append(l.val)

    return r

def GetIndexOfSurface(s, sl):
    for i in range(0, len(sl)):
        if sl[i] == s:
            return i

def GetSurfaceMinX(s):
    a1 = Math.Min(s.PointAtParameter(0,0).X, s.PointAtParameter(0,1).X)
    a2 = Math.Min(s.PointAtParameter(1,0).X, s.PointAtParameter(1,1).X)
    return Math.Min(a1, a2)

def GetSurfaceMaxX(s):
    a1 = Math.Max(s.PointAtParameter(0,0).X, s.PointAtParameter(0,1).X)
    a2 = Math.Max(s.PointAtParameter(1,0).X, s.PointAtParameter(1,1).X)
    return Math.Max(a1, a2)

def GetSurfaceMinY(s):
    a1 = Math.Min(s.PointAtParameter(0,0).Y, s.PointAtParameter(0,1).Y)
    a2 = Math.Min(s.PointAtParameter(1,0).Y, s.PointAtParameter(1,1).Y)
    return Math.Min(a1, a2)

def GetSurfaceMaxY(s):
    a1 = Math.Max(s.PointAtParameter(0,0).Y, s.PointAtParameter(0,1).Y)
    a2 = Math.Max(s.PointAtParameter(1,0).Y, s.PointAtParameter(1,1).Y)
    return Math.Max(a1, a2)


class SortByMinX(object):
     def __init__(self, val):
         self.val = val

     def __lt__(self, other):
         return GetSurfaceMinX(self.val) < GetSurfaceMinX(other.val)

class SortByMinY(object):
     def __init__(self, val):
         self.val = val

     def __lt__(self, other):
         return GetSurfaceMinY(self.val) < GetSurfaceMinY(other.val)


def CreateXCheckerSurface(s):
    minX = GetSurfaceMinX(s)
    minY = GetSurfaceMinY(s)
    maxX = GetSurfaceMaxX(s)
    maxY = GetSurfaceMaxY(s)
    minZ = s.PointAtParameter(0,0).Z
    pl = [
            Point.ByCoordinates(minX - 100000, minY + 0.1, minZ),
            Point.ByCoordinates(minX - 100000, maxY - 0.1, minZ),
            Point.ByCoordinates(minX, maxY - 0.1, minZ),
            Point.ByCoordinates(minX, minY + 0.1, minZ),
        ]

    checkerX = Surface.ByPerimeterPoints(pl)

    return checkerX

def CreateYCheckerSurface(s):
    minX = GetSurfaceMinX(s)
    minY = GetSurfaceMinY(s)
    maxX = GetSurfaceMaxX(s)
    maxY = GetSurfaceMaxY(s)
    minZ = s.PointAtParameter(0,0).Z
    pl = [
            Point.ByCoordinates(minX + 0.1, minY - 100000, minZ),
            Point.ByCoordinates(minX + 0.1, minY, minZ),
            Point.ByCoordinates(maxX - 0.1, minY, minZ),
            Point.ByCoordinates(maxX - 0.1, minY - 100000, minZ),
        ]

    checkerX = Surface.ByPerimeterPoints(pl)

    return checkerX

def GetDistanceXToMove(s, sl):
    checkerX = CreateXCheckerSurface(s)

    cl = []

    noHit = True

    for si in sl:
        if si == s:
            continue
        else:
            if checkerX.DoesIntersect(si) == True:
                noHit = False

                cl.append(si.PointAtParameter(0,0).X)
                cl.append(si.PointAtParameter(0,1).X)
                cl.append(si.PointAtParameter(1,0).X)
                cl.append(si.PointAtParameter(1,1).X)

    if noHit == True:
        return - GetSurfaceMinX(s)
    else:
        cl.sort(reverse=True)
        return cl[0] - GetSurfaceMinX(s)

def GetDistanceYToMove(s, sl):
    checkerY = CreateYCheckerSurface(s)

    cl = []

    noHit = True

    for si in sl:
        if si == s:
            continue
        else:
            if checkerY.DoesIntersect(si) == True:
                noHit = False

                cl.append(si.PointAtParameter(0,0).Y)
                cl.append(si.PointAtParameter(0,1).Y)
                cl.append(si.PointAtParameter(1,0).Y)
                cl.append(si.PointAtParameter(1,1).Y)

    if noHit == True:
        return - GetSurfaceMinY(s)
    else:
        cl.sort(reverse=True)
        return cl[0] - GetSurfaceMinY(s)


def MoveX():
    xOrdered = GetXOrderSurfaces(surfacelist)

    for s in xOrdered:    
        toMoveX = GetDistanceXToMove(s, surfacelist)
        idx = GetIndexOfSurface(s, surfacelist)
        surfacelist[idx] = Geometry.Translate(surfacelist[idx], toMoveX, 0, 0)

def MoveY():
    yOrdered = GetYOrderSurfaces(surfacelist)

    for s in yOrdered:
        toMoveY = GetDistanceYToMove(s, surfacelist)
        idx = GetIndexOfSurface(s, surfacelist)
        surfacelist[idx] = Geometry.Translate(surfacelist[idx], 0, toMoveY, 0)

def SplitX():
    xOrdered = GetXOrderSurfaces(surfacelist)

    offsetX = 0   
    for i in range(0, len(xOrdered)):
        idx = GetIndexOfSurface(xOrdered[i], surfacelist)

        mx = offsetX - GetSurfaceMinX(surfacelist[idx])
        surfacelist[idx] = Geometry.Translate(surfacelist[idx], mx, 0, 0)

        sx = GetSurfaceMaxX(surfacelist[idx]) - GetSurfaceMinX(surfacelist[idx])
        offsetX = offsetX + sx

def SplitY():
    yOrdered = GetYOrderSurfaces(surfacelist)

    offsetY = 0   
    for i in range(0, len(yOrdered)):
        idx = GetIndexOfSurface(yOrdered[i], surfacelist)

        my = offsetY - GetSurfaceMinY(surfacelist[idx])
        surfacelist[idx] = Geometry.Translate(surfacelist[idx], 0, my, 0)

        sy = GetSurfaceMaxY(surfacelist[idx]) - GetSurfaceMinY(surfacelist[idx])
        offsetY = offsetY + sy

def MinofAll():
    allX = []
    allY = []
    for s in surfacelist:
        allX.append(GetSurfaceMinX(s))
        allY.append(GetSurfaceMinY(s))
    allX.sort()
    allY.sort()
    x = 0
    if allX[0] < 0:
        x = -allX[0]
    y = 0
    if allY[0] < 0:
        y = -allY[0]

    return x,y



# 이 노드에 대한 입력값은 IN 변수에 리스트로 저장됩니다.
dataEnteringNode = IN

# 코드를 이 선 아래에 배치

surfaces = IN[0]

surfaceLists = []
for sl in surfaces:
    tmps = []
    for s in sl:
        tmps.append(s)
    surfaceLists.append(tmps)

surfacelist = []


for l in range(0, len(surfaceLists)):
    surfacelist = surfaceLists[l]
# for s in surfaces:
#     surfacelist.append(s)

    (basX, basY) = MinofAll()
    for i in range(0, len(surfacelist)):
        surfacelist[i] = Geometry.Translate(surfacelist[i], basX, basY, 0)

    if randint(0, 1) == 0:
        SplitX()
        MoveX()
        MoveY()
        MoveX()
        MoveY()
    else:
        SplitY()
        MoveY()
        MoveX()
        MoveY()
        MoveX()

# testnum = IN[1]
# xOrdered = GetXOrderSurfaces(surfacelist)

# # for s in xOrdered:    
# toMoveX = GetDistanceXToMove(xOrdered[testnum], surfacelist)
# idx = GetIndexOfSurface(xOrdered[testnum], surfacelist)
# surfacelist[idx] = Geometry.Translate(surfacelist[idx], toMoveX, 0, 0)



# 출력을 OUT 변수에 지정합니다.
OUT = surfaceLists
# ----------------------------------------
# note: 2
python_script_4 = Python()  # IronPython2; unwired: IN[0]; same code as python_script_3
