# Dynamo graph 0825 space planning test 008CN_mk_수정_python.dyn (Dynamo 2.10.1.3976)
# packages: GenerativeDesign.Revit 1.7.3.0, GenerativeDesign 1.7.3.0, Clockwork for Dynamo 2.x 2.3.0

# note: Center point
# note: Surfaces

# group: User Inputs for GDIR
# note: Custom Package: GenerativeDesign v.2021.5.5
select_room_to_load_program_into = DSModelRoomSelection()  # 1 picked in the model; graph input
# note: Retrieve the room's finish boundary.
# Note: The first sublist is the outermost boundary of the room.
finishBoundary = Room.FinishBoundary(room=select_room_to_load_program_into)
remember = Data.Remember(finishBoundary)

# group: Extract room boundary for DynaSpace and cache it in the graph
firstItem = List.FirstItem(list=remember@L3)
startPoint = Curve.StartPoint(curve=firstItem)
flatten = List.Flatten(list=startPoint)
byJoinedCurves = PolyCurve.ByJoinedCurves(curves=firstItem)
code_block = CodeBlock(BldgBoundary=byJoinedCurves)
# ---------- code_block.designscript (3 lines) ----------
{
"BldgBoundary": _BldgBoundary
};
# ----------------------------------------

# group: Excel Data import (package 정리 전)
file_path = Filename(".\space planning test 0802mk 001.xlsx")
file_from_path = FileObject(path=file_path)
string_from_object = FromObject(object=file_from_path)
code_block_2 = CodeBlock { "Sheet1"; "SampleBuildingProgram-Clinic"; false; }
python_script_import_excel_by = Python(IN[0]=string_from_object, IN[1]=code_block_2.out0)  # "Python Script@Import Excel(By OpenpyXl)"; CPython3
# ---------- python_script_import_excel_by.python (50 lines) ----------
# Load the Python Standard and DesignScript Libraries
import sys
import os
#sys.path.append(r'C:\Users\HEC\AppData\Local\Programs\Python\Python39\Lib\site-packages')
#sys.path.append(r'C:\Users\pjmk0\AppData\Local\Programs\Python\Python39\Lib\site-packages')
sys.path.append(os.getenv('LOCALAPPDATA').replace('\\','\\\\') + r'\Programs\Python\Python39\Lib\site-packages')
import clr
clr.AddReference('ProtoGeometry')
from Autodesk.DesignScript.Geometry import *
from collections import Iterable

def iterable(obj):
    return isinstance(obj, Iterable)


# The inputs to this node will be stored as a list in the IN variables.
dataEnteringNode = IN
PathIn = IN[0]
SheetNameIn = IN[1]

# Place your code below this line
import datetime
import openpyxl

path = (PathIn)
#path = (r'C:\Users\pjmk0\Downloads\MK\mQ\BIM_물량집계 자동화 산출기준표_rC(20210607)_mk_de.xlsx')

wb_obj = openpyxl.load_workbook(path, data_only=True)
sheet_obj = wb_obj.get_sheet_by_name(SheetNameIn)

m_row = sheet_obj.max_row
m_col = sheet_obj.max_column

listOut = []



for i in range(1, m_row +1):
    listTemp = []
    for j in range(1, m_col + 1):
        cell_obj = sheet_obj.cell(row=i, column=j)
        listTemp.append(cell_obj.value)
        if len(listTemp) == m_col:
            listOut.append(listTemp)
        


# Assign your output to the OUT variable.
OUT = listOut
#OUT = os.getenv('APPDATA')
# ----------------------------------------
excel_data_정리_전 = Watch(python_script_import_excel_by)

remember_2 = Data.Remember(excel_data_정리_전)

# group: Excel List 분할
excel_data_정리_전_2 = Watch(remember_2)
transpose = List.Transpose(lists=excel_data_정리_전_2)
code_block_3 = CodeBlock { 1; }
# note: List Name 정리
dropItems = List.DropItems(list=transpose@L2, amount=code_block_3)
watch = Watch(dropItems)
code_block_4 = CodeBlock { 0; }
getItemAtIndex = List.GetItemAtIndex(list=watch, index=code_block_4)
space_id = Watch(getItemAtIndex)
code_block_5 = CodeBlock { 1; }
getItemAtIndex_2 = List.GetItemAtIndex(list=watch, index=code_block_5)
space_name = Watch(getItemAtIndex_2)
code_block_6 = CodeBlock { 10; }
getItemAtIndex_3 = List.GetItemAtIndex(list=watch, index=code_block_6)
adjacent_spaces = Watch(getItemAtIndex_3)
code_block_7 = CodeBlock { 3; }
getItemAtIndex_4 = List.GetItemAtIndex(list=watch, index=code_block_7)
department_id = Watch(getItemAtIndex_4)
code_block_8 = CodeBlock { 2; }
getItemAtIndex_5 = List.GetItemAtIndex(list=watch, index=code_block_8)
DEPARTMENT = Watch(getItemAtIndex_5)
code_block_9 = CodeBlock { 5; }
getItemAtIndex_6 = List.GetItemAtIndex(list=watch, index=code_block_9)
WIDTH = Watch(getItemAtIndex_6)
code_block_10 = CodeBlock { 6; }
getItemAtIndex_7 = List.GetItemAtIndex(list=watch, index=code_block_10)
length = Watch(getItemAtIndex_7)
code_block_11 = CodeBlock { 7; }
getItemAtIndex_8 = List.GetItemAtIndex(list=watch, index=code_block_11)
height = Watch(getItemAtIndex_8)
code_block_12 = CodeBlock { 8; }
getItemAtIndex_9 = List.GetItemAtIndex(list=watch, index=code_block_12)
AREA = Watch(getItemAtIndex_9)
code_block_13 = CodeBlock { 14; }
getItemAtIndex_10 = List.GetItemAtIndex(list=watch, index=code_block_13)
rotate = Watch(getItemAtIndex_10)
code_block_14 = CodeBlock { 15; }
getItemAtIndex_11 = List.GetItemAtIndex(list=watch, index=code_block_14)
rotate_2 = Watch(getItemAtIndex_11)

code_block_15 = CodeBlock { 11; }
getItemAtIndex_12 = List.GetItemAtIndex(list=watch, index=code_block_15)

# group (continued): Excel List 분할
lev = Watch(getItemAtIndex_12)
code_block_16 = CodeBlock(ExcelDataWithNoHead=watch, SpaceID=space_id, SpaceName=space_name, AdjacentSpaces=adjacent_spaces, DepartmentID=department_id, Department=DEPARTMENT, Level=lev, Width=WIDTH, Length=length, Height=height, Area=AREA, Rotate=rotate, Cluster=rotate_2)
# ---------- code_block_16.designscript (15 lines) ----------
{
"ExcelDataWithNoHead": _ExcelDataWithNoHead,
"SpaceID": _SpaceID,
"SpaceName": _SpaceName,
"AdjacentSpaces": _AdjacentSpaces,
"DepartmentID": _DepartmentID,
"Department": _Department,
"Level": _Level,
"Width": _Width,
"Length": _Length,
"Height": _Height,
"Area": _Area,
"Rotate": _Rotate,
"Cluster": _Cluster
};
# ----------------------------------------

code_block_17 = CodeBlock(InputDic=code_block_16) { _InputDic; }
code_block_18 = CodeBlock { "Width"; }
valueAtKey = DesignScript.Builtin.Dictionary.ValueAtKey(dictionary=code_block_17, key=code_block_18)
code_block_19 = CodeBlock { "Length"; }
valueAtKey_2 = DesignScript.Builtin.Dictionary.ValueAtKey(dictionary=code_block_17, key=code_block_19)
code_block_20 = CodeBlock { "Height"; }
valueAtKey_3 = DesignScript.Builtin.Dictionary.ValueAtKey(dictionary=code_block_17, key=code_block_20)
byLengths = Cuboid.ByLengths(width=valueAtKey, length=valueAtKey_2, height=valueAtKey_3)
centroid = Solid.Centroid(solid=byLengths)

# group: 고정부 Seed
seed_고정부_코어 = DoubleSlider(610, range=0..999 step 1)  # graph input

# group: 변동부 Seed
seed_변형부_공간 = DoubleSlider(875, range=0..999 step 1)  # graph input

# group: 회전 Seed
seed_회전용 = DoubleSlider(251, range=0..999 step 1)  # graph input

# group: Floor Level
code_block_21 = CodeBlock { [-6000,0,6000,12000]; }

code_block_22 = CodeBlock(FixedPartSeed=seed_고정부_코어, NonFixedPartSeed=seed_변형부_공간, RotatingSeed=seed_회전용, FloorLevel=code_block_21)
# ---------- code_block_22.designscript (6 lines) ----------
{
"FixedPartSeed": _FixedPartSeed,
"NonFixedPartSeed": _NonFixedPartSeed,
"RotatingSeed": _RotatingSeed,
"FloorLevel": _FloorLevel
};
# ----------------------------------------
extendsChildDictionaryFromParent = Custom[ExtendsChildDictionaryFromParent](ParentDic=code_block, ChildDic=code_block_22)  # Extends Child Dictionary From Parent
code_block_23 = CodeBlock { "SpaceID"; }
valueAtKey_4 = DesignScript.Builtin.Dictionary.ValueAtKey(dictionary=code_block_17, key=code_block_23)
code_block_24 = CodeBlock { "SpaceName"; }
valueAtKey_5 = DesignScript.Builtin.Dictionary.ValueAtKey(dictionary=code_block_17, key=code_block_24)
code_block_25 = CodeBlock { "AdjacentSpaces"; }
valueAtKey_6 = DesignScript.Builtin.Dictionary.ValueAtKey(dictionary=code_block_17, key=code_block_25)
code_block_26 = CodeBlock { "DepartmentID"; }
valueAtKey_7 = DesignScript.Builtin.Dictionary.ValueAtKey(dictionary=code_block_17, key=code_block_26)
code_block_27 = CodeBlock { "Department"; }
valueAtKey_8 = DesignScript.Builtin.Dictionary.ValueAtKey(dictionary=code_block_17, key=code_block_27)
code_block_28 = CodeBlock { "Level"; }
valueAtKey_9 = DesignScript.Builtin.Dictionary.ValueAtKey(dictionary=code_block_17, key=code_block_28)
code_block_29 = CodeBlock { "Area"; }
valueAtKey_10 = DesignScript.Builtin.Dictionary.ValueAtKey(dictionary=code_block_17, key=code_block_29)
code_block_30 = CodeBlock { "Rotate"; }
valueAtKey_11 = DesignScript.Builtin.Dictionary.ValueAtKey(dictionary=code_block_17, key=code_block_30)
code_block_31 = CodeBlock { "Cluster"; }
valueAtKey_12 = DesignScript.Builtin.Dictionary.ValueAtKey(dictionary=code_block_17, key=code_block_31)
code_block_32 = CodeBlock(BoxSpaceID=valueAtKey_4, BoxSpaceName=valueAtKey_5, BoxAdjacentSpaces=valueAtKey_6, BoxDepartmentID=valueAtKey_7, BoxDepartment=valueAtKey_8, BoxLevel=valueAtKey_9, BoxWidth=valueAtKey, BoxLength=valueAtKey_2, BoxHeight=valueAtKey_3, BoxArea=valueAtKey_10, BoxRotate=valueAtKey_11, BoxCluster=valueAtKey_12)
# ---------- code_block_32.designscript (15 lines) ----------
///Box Class Primary
{
"BoxSpaceID": _BoxSpaceID,
"BoxSpaceName": _BoxSpaceName,
"BoxAdjacentSpaces": _BoxAdjacentSpaces,
"BoxDepartmentID": _BoxDepartmentID,
"BoxDepartment": _BoxDepartment,
"BoxLevel": _BoxLevel,
"BoxWidth": _BoxWidth,
"BoxLength": _BoxLength,
"BoxHeight": _BoxHeight,
"BoxArea": _BoxArea,
"BoxRotate": _BoxRotate,
"BoxCluster": _BoxCluster
};
# ----------------------------------------
code_block_33 = CodeBlock(BoxClass_Primary=code_block_32)
# ---------- code_block_33.designscript (3 lines) ----------
{
"BoxClass_Primary": _BoxClass_Primary
};
# ----------------------------------------
extendsChildDictionaryFromParent_2 = Custom[ExtendsChildDictionaryFromParent](ParentDic=extendsChildDictionaryFromParent.dictionary, ChildDic=code_block_33)
setBoxZvalueProp = Custom[SetBoxZvalueProp](InputDic=extendsChildDictionaryFromParent_2.dictionary)  # SetBoxZvalueProp
createGridPointOfBldgBoundary = Custom[CreateGridPointOfBldgBoundary](InputDic=setBoxZvalueProp)  # CreateGridPointOfBldgBoundary
distributeRandomSeedForFixedPart = Custom[DistributeRandomSeedForFixedPart](InputDic=createGridPointOfBldgBoundary)  # DistributeRandomSeedForFixedPart
placeFixedPartBoxBySeed = Custom[PlaceFixedPartBoxBySeed](InputDic=distributeRandomSeedForFixedPart)  # PlaceFixedPartBoxBySeed
extractUnoccupiedGridPointsByLevel = Custom[ExtractUnoccupiedGridPointsByLevel](InputDic=placeFixedPartBoxBySeed)  # ExtractUnoccupiedGridPointsByLevel
findNonFixedPartBox = Custom[FindNonFixedPartBox](InputDic=extractUnoccupiedGridPointsByLevel)  # FindNonFixedPartBox
distributeRandomSeedForNonFixedPart = Custom[DistributeRandomSeedForNonFixedPart](InputDic=findNonFixedPartBox)  # DistributeRandomSeedForNonFixedPart

# group: Non-Fixed Part 형상 배치 by Seed(회전 고려)
code_block_34 = CodeBlock(InputDic=distributeRandomSeedForNonFixedPart) { _InputDic; }
code_block_35 = CodeBlock { "BoxClass_nonfixedpart"; }
code_block_36 = CodeBlock { "BoxGeometry"; }
code_block_37 = CodeBlock { "BoxClass_nonfixedpart"; }
valueAtKey_13 = DesignScript.Builtin.Dictionary.ValueAtKey(dictionary=code_block_34, key=code_block_37)
components = DesignScript.Builtin.Dictionary.Components(dictionary=valueAtKey_13)
addItemToEnd = List.AddItemToEnd(item=code_block_36, list=components.keys)
code_block_38 = CodeBlock { "RestGridPointByLevel"; }
valueAtKey_14 = DesignScript.Builtin.Dictionary.ValueAtKey(dictionary=code_block_34, key=code_block_38)
code_block_39 = CodeBlock { "BoxSeed(nonfixed)"; }
valueAtKey_15 = DesignScript.Builtin.Dictionary.ValueAtKey(dictionary=valueAtKey_13, key=code_block_39)
code_block_40 = CodeBlock { "BoxLevel"; }
valueAtKey_16 = DesignScript.Builtin.Dictionary.ValueAtKey(dictionary=valueAtKey_13, key=code_block_40)
uniqueItems = List.UniqueItems(list=valueAtKey_16)
allIndicesOf = List.AllIndicesOf(list=valueAtKey_16, item=uniqueItems)
count = List.Count(list=allIndicesOf@L2)
chop = List.Chop(list=valueAtKey_15, lengths=count)
getItemAtIndex_13 = List.GetItemAtIndex(list=valueAtKey_14@L2, index=chop@L2)
X = Point.X(point=getItemAtIndex_13)
flatten_2 = List.Flatten(list=X)
Y = Point.Y(point=getItemAtIndex_13)
flatten_3 = List.Flatten(list=Y)
code_block_41 = CodeBlock { "BoxZvalue"; }
valueAtKey_17 = DesignScript.Builtin.Dictionary.ValueAtKey(dictionary=valueAtKey_13, key=code_block_41)
firstItem_2 = List.FirstItem(list=valueAtKey_17)
code_block_42 = CodeBlock(i=valueAtKey_17, j=firstItem_2) { i+Math.Abs(j/2); }
byCoordinates = Point.ByCoordinates(x=flatten_2, y=flatten_3, z=code_block_42)
flatten_4 = List.Flatten(list=byCoordinates)
code_block_43 = CodeBlock { "BoxWidth"; }
valueAtKey_18 = DesignScript.Builtin.Dictionary.ValueAtKey(dictionary=valueAtKey_13, key=code_block_43)
code_block_44 = CodeBlock { "BoxLength"; }
valueAtKey_19 = DesignScript.Builtin.Dictionary.ValueAtKey(dictionary=valueAtKey_13, key=code_block_44)
code_block_45 = CodeBlock { "BoxHeight"; }
valueAtKey_20 = DesignScript.Builtin.Dictionary.ValueAtKey(dictionary=valueAtKey_13, key=code_block_45)
byLengths_2 = Cuboid.ByLengths(origin=flatten_4, width=valueAtKey_18, length=valueAtKey_19, height=valueAtKey_20)
centroid_2 = Solid.Centroid(solid=byLengths_2)
ZAxis = Vector.ZAxis()
code_block_46 = CodeBlock { "BoxSpaceName"; }
valueAtKey_21 = DesignScript.Builtin.Dictionary.ValueAtKey(dictionary=valueAtKey_13, key=code_block_46)
count_2 = List.Count(list=valueAtKey_21)
code_block_47 = CodeBlock { 0; }
code_block_48 = CodeBlock { 90; }
code_block_49 = CodeBlock { "RotatingSeed"; }
valueAtKey_22 = DesignScript.Builtin.Dictionary.ValueAtKey(dictionary=code_block_34, key=code_block_49)
randomList = Math.RandomList(amount=count_2, value1=code_block_47, value2=code_block_48, seed=valueAtKey_22)
code_block_50 = CodeBlock(i=randomList) { i>=45; }
code_block_51 = CodeBlock { 90; 0; }

watch_2 = Watch(code_block_50)
code_block_52 = CodeBlock { "BoxClass_nonfixedpart"; }
valueAtKey_23 = DesignScript.Builtin.Dictionary.ValueAtKey(dictionary=code_block_34, key=code_block_52)
code_block_53 = CodeBlock { "BoxRotate"; }
valueAtKey_24 = DesignScript.Builtin.Dictionary.ValueAtKey(dictionary=valueAtKey_23, key=code_block_53)
watch_3 = Watch(valueAtKey_24)
code_block_54 = CodeBlock { 1; }
allIndicesOf_2 = List.AllIndicesOf(list=watch_3, item=code_block_54)
watch_4 = Watch(byLengths_2)
explode = Geometry.Explode(geometry=watch_4)
watch_5 = Watch(explode)
code_block_55 = CodeBlock { 0.5; }
normalAtParameter = Surface.NormalAtParameter(surface=watch_5, u=code_block_55, v=code_block_55)
watch_6 = Watch(normalAtParameter)
Z = Vector.Z(vector=watch_6)
code_block_56 = CodeBlock { -1; }
eq = Z == code_block_56
filterByBoolMask = List.FilterByBoolMask(list=watch_5, mask=eq)
flatten_5 = List.Flatten(list=filterByBoolMask.in)
code_block_57 = CodeBlock { 0; 1; 0.5; }
pointAtParameter = Surface.PointAtParameter(surface=flatten_5, u=code_block_57.out1, v=code_block_57.out2)
pointAtParameter_2 = Surface.PointAtParameter(surface=flatten_5, u=code_block_57.out0, v=code_block_57.out2)
byStartPointEndPoint = Line.ByStartPointEndPoint(startPoint=pointAtParameter, endPoint=pointAtParameter_2)
length_2 = Curve.Length(curve=byStartPointEndPoint)
pointAtParameter_3 = Surface.PointAtParameter(surface=flatten_5, u=code_block_57.out2, v=code_block_57.out1)
pointAtParameter_4 = Surface.PointAtParameter(surface=flatten_5, u=code_block_57.out2, v=code_block_57.out0)
byStartPointEndPoint_2 = Line.ByStartPointEndPoint(startPoint=pointAtParameter_3, endPoint=pointAtParameter_4)
length_3 = Curve.Length(curve=byStartPointEndPoint_2)
gt = length_2 > length_3
if_ = If(test=gt, true=byStartPointEndPoint, false=byStartPointEndPoint_2)
direction = Line.Direction(line=if_)
watch_7 = Watch(direction)
normalized = Vector.Normalized(vector=watch_7)
watch_8 = Watch(normalized)
watch_9 = Watch(byJoinedCurves)

# group: 대지 장변 찾기
watch_10 = Watch(watch_9)
byPatch = Surface.ByPatch(closedCurve=watch_10)
code_block_58 = CodeBlock { 0; 1; 0.5; }
pointAtParameter_5 = Surface.PointAtParameter(surface=byPatch, u=code_block_58.out1, v=code_block_58.out2)
pointAtParameter_6 = Surface.PointAtParameter(surface=byPatch, u=code_block_58.out0, v=code_block_58.out2)
byStartPointEndPoint_3 = Line.ByStartPointEndPoint(startPoint=pointAtParameter_5, endPoint=pointAtParameter_6)
pointAtParameter_7 = Surface.PointAtParameter(surface=byPatch, u=code_block_58.out2, v=code_block_58.out1)
pointAtParameter_8 = Surface.PointAtParameter(surface=byPatch, u=code_block_58.out2, v=code_block_58.out0)
byStartPointEndPoint_4 = Line.ByStartPointEndPoint(startPoint=pointAtParameter_7, endPoint=pointAtParameter_8)

length_4 = Curve.Length(curve=byStartPointEndPoint_3)
length_5 = Curve.Length(curve=byStartPointEndPoint_4)
gt_2 = length_4 > length_5
direction_2 = Line.Direction(line=byStartPointEndPoint_3)
watch_11 = Watch(direction_2)
normalized_2 = Vector.Normalized(vector=watch_11)
watch_12 = Watch(normalized_2)
direction_3 = Line.Direction(line=byStartPointEndPoint_4)
watch_13 = Watch(direction_3)
normalized_3 = Vector.Normalized(vector=watch_13)
watch_14 = Watch(normalized_3)
if_2 = If(test=gt_2, true=watch_12, false=watch_14)
watch_15 = Watch(if_2)
isParallel = Vector.IsParallel(vector=watch_8, other=watch_15, lacing=Longest)
watch_16 = Watch(isParallel)
watch_17 = Watch(watch_16)
getItemAtIndex_14 = List.GetItemAtIndex(list=watch_17, index=allIndicesOf_2)
replaceItemAtIndex = Custom[List.ReplaceItemAtIndex+](seq=watch_2, indices=allIndicesOf_2, replacement=getItemAtIndex_14)  # package Clockwork for Dynamo 2.x; Replaces the item at a given index of a list by another item. Unlike the OOTB node, it can replace items at multiple indeces.

# group (continued): Non-Fixed Part 형상 배치 by Seed(회전 고려)
if_3 = If(test=replaceItemAtIndex, true=code_block_51.out1, false=code_block_51.out0)
flatten_6 = List.Flatten(list=if_3)
rotate_3 = Geometry.Rotate(geometry=byLengths_2, origin=centroid_2, axis=ZAxis, degrees=flatten_6)
addItemToEnd_2 = List.AddItemToEnd(item=rotate_3, list=components.values)
byKeysValues = DesignScript.Builtin.Dictionary.ByKeysValues(keys=addItemToEnd, values=addItemToEnd_2)
setValueAtKeys = DesignScript.Builtin.Dictionary.SetValueAtKeys(dictionary=code_block_34, keys=code_block_35, values=byKeysValues)

code_block_59 = CodeBlock { "BoxClass_fixedpart"; }
valueAtKey_25 = DesignScript.Builtin.Dictionary.ValueAtKey(dictionary=placeFixedPartBoxBySeed, key=code_block_59)
code_block_60 = CodeBlock { "BoxGeometry"; }
valueAtKey_26 = DesignScript.Builtin.Dictionary.ValueAtKey(dictionary=valueAtKey_25, key=code_block_60)
color_palette = ColorPalette({R: 255, G: 20, B: 147, A: 255})
byGeometryColor = Modifiers.GeometryColor.ByGeometryColor(geometry=valueAtKey_26, color=color_palette)
color_palette_2 = ColorPalette({R: 0, G: 255, B: 255, A: 120})
byGeometryColor_2 = Modifiers.GeometryColor.ByGeometryColor(geometry=rotate_3, color=color_palette_2)
watch_18 = Watch(watch_9)
byPatch_2 = Surface.ByPatch(closedCurve=watch_18)
code_block_61 = CodeBlock { 50000; }
thicken = Surface.Thicken(surface=byPatch_2, thickness=code_block_61)
color_palette_3 = ColorPalette({R: 0, G: 250, B: 154, A: 255})
byGeometryColor_3 = Modifiers.GeometryColor.ByGeometryColor(geometry=thicken, color=color_palette_3)
byARGB = Color.ByARGB()

# group: 각층의 Rooms Union Center point
watch_19 = Watch(rotate_3)
centroid_3 = Solid.Centroid(solid=watch_19)
Z_2 = Point.Z(point=centroid_3)
watch_20 = Watch(Z_2)
string_from_object_2 = FromObject(object=watch_20)
uniqueItems_2 = List.UniqueItems(list=string_from_object_2)
eq_2 = uniqueItems_2 == string_from_object_2  # lacing=CrossProduct
filterByBoolMask_2 = List.FilterByBoolMask(list=watch_19, mask=eq_2@L2)
watch_21 = Watch(filterByBoolMask_2.in)
byUnion = Solid.ByUnion(solids=watch_21)
centroid_4 = Solid.Centroid(solid=byUnion)
boundingBox = Geometry.BoundingBox(geometry=byUnion)

# group: func2
explode_2 = Geometry.Explode(geometry=watch_21)
code_block_62 = CodeBlock { 0.5; }
normalAtParameter_2 = Surface.NormalAtParameter(surface=explode_2, u=code_block_62, v=code_block_62)
Z_3 = Vector.Z(vector=normalAtParameter_2)
code_block_63 = CodeBlock(i=Z_3) { i==-1; }
filterByBoolMask_3 = List.FilterByBoolMask(list=explode_2, mask=code_block_63)
code_block_64 = CodeBlock { 1; }
flatten_7 = List.Flatten(list=filterByBoolMask_3.in@L3, amt=code_block_64)
code_block_65 = CodeBlock { 0.5; }
pointAtParameter_9 = Surface.PointAtParameter(surface=flatten_7, u=code_block_65, v=code_block_65)
Z_4 = Point.Z(point=pointAtParameter_9)
flatten_8 = List.Flatten(list=Z_4)
uniqueItems_3 = List.UniqueItems(list=flatten_8)

# group: 각층의 중심점
watch_22 = Watch(watch_9)
byPatch_3 = Surface.ByPatch(closedCurve=watch_22)
translate = Geometry.Translate(geometry=byPatch_3, zTranslation=uniqueItems_3, lacing=Longest)
code_block_66 = CodeBlock { 0.5; }
pointAtParameter_10 = Surface.PointAtParameter(surface=translate, u=code_block_66, v=code_block_66)
toNumber = String.ToNumber(str=uniqueItems_2)

byStartPointEndPoint_5 = Line.ByStartPointEndPoint(startPoint=centroid_4, endPoint=pointAtParameter_10)
direction_4 = Line.Direction(line=byStartPointEndPoint_5)
translate_2 = Geometry.Translate(geometry=watch_21, direction=direction_4)
flatten_9 = List.Flatten(list=translate_2)
watch_23 = Watch(flatten_9)
byUnion_2 = Solid.ByUnion(solids=watch_23)
differenceAll = Solid.DifferenceAll(solid=byUnion_2, others=thicken)
volume = Solid.Volume(solid=differenceAll)  # graph output
separate = Solid.Separate()  # unwired: solid
color_palette_4 = ColorPalette({R: 0, G: 255, B: 255, A: 120})
byGeometryColor_4 = Modifiers.GeometryColor.ByGeometryColor(geometry=translate_2, color=color_palette_4)
direction_5 = Line.Direction(line=byStartPointEndPoint)
watch_24 = Watch(direction_5)
normalized_4 = Vector.Normalized(vector=watch_24)
watch_25 = Watch(normalized_4)
direction_6 = Line.Direction(line=byStartPointEndPoint_2)
watch_26 = Watch(direction_6)
normalized_5 = Vector.Normalized(vector=watch_26)
watch_27 = Watch(normalized_5)
code_block_67 = CodeBlock {  }
code_block_68 = CodeBlock {  }
pointAtParameter_11 = Surface.PointAtParameter(surface=watch_5, v=code_block_55)
watch_28 = Watch(flatten_7)
code_block_69 = CodeBlock(a=watch_28) { a[3]; }
code_block_70 = CodeBlock { 0.2..0.8..0.1; 0..1.5..0.1; }
pointAtParameter_12 = Surface.PointAtParameter(surface=translate, u=code_block_70.out1, v=code_block_70.out1, lacing=CrossProduct)
flatten_10 = List.Flatten(list=pointAtParameter_12)
count_3 = List.Count(list=pointAtParameter_12@L2)
sum = Math.Sum(values=count_3)
code_block_71 = CodeBlock(a=sum) { a/4; }
chop_2 = List.Chop(list=flatten_10, lengths=code_block_71)
code_block_72 = CodeBlock(a=chop_2) { a[3]; }
code_block_73 = CodeBlock(surfaces=code_block_69, points=code_block_72) { surfaces; points; }
number_slider = DoubleSlider(4, range=0..100 step 1)
python_script = Python(IN[0]=code_block_73.surfaces, IN[1]=code_block_73.points, IN[2]=number_slider)  # IronPython2
# ---------- python_script.python (48 lines) ----------
# Python 표준 및 DesignScript 라이브러리 로드
import random
import sys
import clr
clr.AddReference('ProtoGeometry')
from Autodesk.DesignScript.Geometry import *

# 이 노드에 대한 입력값은 IN 변수에 리스트로 저장됩니다.
dataEnteringNode = IN


surfaces = IN[0]
points = IN[1]
checks = [False for i in range(len(points))]

random.seed(a=None)

n = len(surfaces)
cnt = 0

result = []

while cnt < n:
    r = random.randint(0, len(points) - 1)

    test = Geometry.Translate(surfaces[cnt], points[r].X, points[r].Y, 0)

    validCheck = True

    for i in range(0, len(points) - 1):
        if test.Intersect(points[i]) and checks[i] == True:
            validCheck = False
            break

    if validCheck == True:
        for i in range(0, len(points) - 1):
            if test.Intersect(points[i]):
                checks[i] = True
        cnt = cnt + 1
        result.append(test)
        



# 코드를 이 선 아래에 배치

# 출력을 OUT 변수에 지정합니다.
OUT = result
# ----------------------------------------
number = DoubleInput(0)
python_script_2 = Python(IN[0]=code_block_73.surfaces, IN[1]=number)  # IronPython2
# ---------- python_script_2.python (264 lines) ----------
# Python 표준 및 DesignScript 라이브러리 로드
from random import randint
import sys
import clr
clr.AddReference('ProtoGeometry')
clr.AddReference('DSCoreNodes')
from DSCore import *
from Autodesk.DesignScript.Geometry import *



def GetXOrderSurfaces(sl):
    ls = []
    for s in sl:
        ls.append(SortByMinX(s))

    ls.sort()

    r = []
    for l in ls:
        r.append(l.val)

    return r

def GetYOrderSurfaces(sl):
    ls = []
    for s in sl:
        ls.append(SortByMinY(s))

    ls.sort()

    r = []
    for l in ls:
        r.append(l.val)

    return r

def GetIndexOfSurface(s, sl):
    for i in range(0, len(sl)):
        if sl[i] == s:
            return i

def GetSurfaceMinX(s):
    a1 = Math.Min(s.PointAtParameter(0,0).X, s.PointAtParameter(0,1).X)
    a2 = Math.Min(s.PointAtParameter(1,0).X, s.PointAtParameter(1,1).X)
    return Math.Min(a1, a2)

def GetSurfaceMaxX(s):
    a1 = Math.Max(s.PointAtParameter(0,0).X, s.PointAtParameter(0,1).X)
    a2 = Math.Max(s.PointAtParameter(1,0).X, s.PointAtParameter(1,1).X)
    return Math.Max(a1, a2)

def GetSurfaceMinY(s):
    a1 = Math.Min(s.PointAtParameter(0,0).Y, s.PointAtParameter(0,1).Y)
    a2 = Math.Min(s.PointAtParameter(1,0).Y, s.PointAtParameter(1,1).Y)
    return Math.Min(a1, a2)

def GetSurfaceMaxY(s):
    a1 = Math.Max(s.PointAtParameter(0,0).Y, s.PointAtParameter(0,1).Y)
    a2 = Math.Max(s.PointAtParameter(1,0).Y, s.PointAtParameter(1,1).Y)
    return Math.Max(a1, a2)


class SortByMinX(object):
     def __init__(self, val):
         self.val = val

     def __lt__(self, other):
         return GetSurfaceMinX(self.val) < GetSurfaceMinX(other.val)

class SortByMinY(object):
     def __init__(self, val):
         self.val = val

     def __lt__(self, other):
         return GetSurfaceMinY(self.val) < GetSurfaceMinY(other.val)


def CreateXCheckerSurface(s):
    minX = GetSurfaceMinX(s)
    minY = GetSurfaceMinY(s)
    maxX = GetSurfaceMaxX(s)
    maxY = GetSurfaceMaxY(s)
    minZ = s.PointAtParameter(0,0).Z
    pl = [
            Point.ByCoordinates(minX - 100000, minY + 0.1, minZ),
            Point.ByCoordinates(minX - 100000, maxY - 0.1, minZ),
            Point.ByCoordinates(minX, maxY - 0.1, minZ),
            Point.ByCoordinates(minX, minY + 0.1, minZ),
        ]

    checkerX = Surface.ByPerimeterPoints(pl)

    return checkerX

def CreateYCheckerSurface(s):
    minX = GetSurfaceMinX(s)
    minY = GetSurfaceMinY(s)
    maxX = GetSurfaceMaxX(s)
    maxY = GetSurfaceMaxY(s)
    minZ = s.PointAtParameter(0,0).Z
    pl = [
            Point.ByCoordinates(minX + 0.1, minY - 100000, minZ),
            Point.ByCoordinates(minX + 0.1, minY, minZ),
            Point.ByCoordinates(maxX - 0.1, minY, minZ),
            Point.ByCoordinates(maxX - 0.1, minY - 100000, minZ),
        ]

    checkerX = Surface.ByPerimeterPoints(pl)

    return checkerX

def GetDistanceXToMove(s, sl):
    checkerX = CreateXCheckerSurface(s)

    cl = []

    noHit = True

    for si in sl:
        if si == s:
            continue
        else:
            if checkerX.DoesIntersect(si) == True:
                noHit = False

                cl.append(si.PointAtParameter(0,0).X)
                cl.append(si.PointAtParameter(0,1).X)
                cl.append(si.PointAtParameter(1,0).X)
                cl.append(si.PointAtParameter(1,1).X)

    if noHit == True:
        return - GetSurfaceMinX(s)
    else:
        cl.sort(reverse=True)
        return cl[0] - GetSurfaceMinX(s)

def GetDistanceYToMove(s, sl):
    checkerY = CreateYCheckerSurface(s)

    cl = []

    noHit = True

    for si in sl:
        if si == s:
            continue
        else:
            if checkerY.DoesIntersect(si) == True:
                noHit = False

                cl.append(si.PointAtParameter(0,0).Y)
                cl.append(si.PointAtParameter(0,1).Y)
                cl.append(si.PointAtParameter(1,0).Y)
                cl.append(si.PointAtParameter(1,1).Y)

    if noHit == True:
        return - GetSurfaceMinY(s)
    else:
        cl.sort(reverse=True)
        return cl[0] - GetSurfaceMinY(s)


def MoveX():
    xOrdered = GetXOrderSurfaces(surfacelist)

    for s in xOrdered:    
        toMoveX = GetDistanceXToMove(s, surfacelist)
        idx = GetIndexOfSurface(s, surfacelist)
        surfacelist[idx] = Geometry.Translate(surfacelist[idx], toMoveX, 0, 0)

def MoveY():
    yOrdered = GetYOrderSurfaces(surfacelist)

    for s in yOrdered:
        toMoveY = GetDistanceYToMove(s, surfacelist)
        idx = GetIndexOfSurface(s, surfacelist)
        surfacelist[idx] = Geometry.Translate(surfacelist[idx], 0, toMoveY, 0)

def SplitX():
    xOrdered = GetXOrderSurfaces(surfacelist)

    offsetX = 0   
    for i in range(0, len(xOrdered)):
        idx = GetIndexOfSurface(xOrdered[i], surfacelist)

        mx = offsetX - GetSurfaceMinX(surfacelist[idx])
        surfacelist[idx] = Geometry.Translate(surfacelist[idx], mx, 0, 0)

        sx = GetSurfaceMaxX(surfacelist[idx]) - GetSurfaceMinX(surfacelist[idx])
        offsetX = offsetX + sx

def SplitY():
    yOrdered = GetYOrderSurfaces(surfacelist)

    offsetY = 0   
    for i in range(0, len(yOrdered)):
        idx = GetIndexOfSurface(yOrdered[i], surfacelist)

        my = offsetY - GetSurfaceMinY(surfacelist[idx])
        surfacelist[idx] = Geometry.Translate(surfacelist[idx], 0, my, 0)

        sy = GetSurfaceMaxY(surfacelist[idx]) - GetSurfaceMinY(surfacelist[idx])
        offsetY = offsetY + sy

def MinofAll():
    allX = []
    allY = []
    for s in surfacelist:
        allX.append(GetSurfaceMinX(s))
        allY.append(GetSurfaceMinY(s))
    allX.sort()
    allY.sort()
    x = 0
    if allX[0] < 0:
        x = -allX[0]
    y = 0
    if allY[0] < 0:
        y = -allY[0]

    return x,y



# 이 노드에 대한 입력값은 IN 변수에 리스트로 저장됩니다.
dataEnteringNode = IN

# 코드를 이 선 아래에 배치

surfaces = IN[0]

surfacelist = []
for s in surfaces:
    surfacelist.append(s)

(basX, basY) = MinofAll()
for i in range(0, len(surfacelist)):
    surfacelist[i] = Geometry.Translate(surfacelist[i], basX, basY, 0)

if randint(0, 1) == 0:
    SplitX()
    MoveX()
    MoveY()
    MoveX()
    MoveY()
else:
    SplitY()
    MoveY()
    MoveX()
    MoveY()
    MoveX()

# testnum = IN[1]
# xOrdered = GetXOrderSurfaces(surfacelist)

# # for s in xOrdered:    
# toMoveX = GetDistanceXToMove(xOrdered[testnum], surfacelist)
# idx = GetIndexOfSurface(xOrdered[testnum], surfacelist)
# surfacelist[idx] = Geometry.Translate(surfacelist[idx], toMoveX, 0, 0)



# 출력을 OUT 변수에 지정합니다.
OUT = surfacelist
# ----------------------------------------
code_block_74 = CodeBlock {  }
code_block_75 = CodeBlock {  }
color_palette_5 = ColorPalette({R: 0, G: 255, B: 0, A: 106})
byGeometryColor_5 = Modifiers.GeometryColor.ByGeometryColor(color=color_palette_5)  # unwired: geometry
code_block_76 = CodeBlock {  }
code_block_77 = CodeBlock {  }
translate_3 = Geometry.Translate(geometry=code_block_72)
translate_4 = Geometry.Translate(geometry=code_block_73.surfaces)
code_block_78 = CodeBlock { t1 = 0; num1 = Math.Min(t1, t1); num2 = Math.Abs(num1); }
list_create = List.Create()  # unwired: item0, item1, item2
byJoinedSurfaces = PolySurface.ByJoinedSurfaces(surfaces=list_create)
code_block_79 = CodeBlock { 0.5; }
pointAtParameter_13 = Surface.PointAtParameter(surface=byJoinedSurfaces@L2, u=code_block_79, v=code_block_79)
perimeterCurves = Surface.PerimeterCurves(surface=byJoinedSurfaces)
flatten_11 = List.Flatten(list=perimeterCurves)
code_block_80 = CodeBlock { corepoint; }  # unwired: corepoint
join = List.Join()  # unwired: list0, list1, list2
byStartPointEndPoint_6 = Line.ByStartPointEndPoint(startPoint=code_block_80, endPoint=join)
doesIntersect = Geometry.DoesIntersect(geometry=byStartPointEndPoint_6, other=flatten_11, lacing=CrossProduct)
filterByBoolMask_4 = List.FilterByBoolMask(list=flatten_11, mask=doesIntersect@L2)
flatten_12 = List.Flatten(list=filterByBoolMask_4.in)
code_block_81 = CodeBlock { 2; }
offset = Curve.Offset(curve=flatten_12, distance=code_block_81)
list_create_2 = List.Create(item0=flatten_12, item1=offset)
transpose_2 = List.Transpose(lists=list_create_2)
byLoft = Surface.ByLoft(crossSections=transpose_2)
list_create_3 = List.Create(item0=byJoinedSurfaces, item1=byLoft)
transpose_3 = List.Transpose(lists=list_create_3)
byJoinedSurfaces_2 = PolySurface.ByJoinedSurfaces(surfaces=transpose_3)
perimeterCurves_2 = Surface.PerimeterCurves(surface=byJoinedSurfaces_2)
code_block_82 = CodeBlock { -1; }
dropItems_2 = List.DropItems(list=watch_28, amount=code_block_82)
code_block_83 = CodeBlock { 5; }
chop_3 = List.Chop(list=code_block_69, lengths=code_block_83)
join_2 = List.Join(list0=dropItems_2, list1=chop_3)
python_script_3 = Python(IN[0]=join_2)  # IronPython2
# ---------- python_script_3.python (276 lines) ----------
# Python 표준 및 DesignScript 라이브러리 로드
from random import randint
import sys
import clr
import copy
clr.AddReference('ProtoGeometry')
clr.AddReference('DSCoreNodes')
from DSCore import *
from Autodesk.DesignScript.Geometry import *



def GetXOrderSurfaces(sl):
    ls = []
    for s in sl:
        ls.append(SortByMinX(s))

    ls.sort()

    r = []
    for l in ls:
        r.append(l.val)

    return r

def GetYOrderSurfaces(sl):
    ls = []
    for s in sl:
        ls.append(SortByMinY(s))

    ls.sort()

    r = []
    for l in ls:
        r.append(l.val)

    return r

def GetIndexOfSurface(s, sl):
    for i in range(0, len(sl)):
        if sl[i] == s:
            return i

def GetSurfaceMinX(s):
    a1 = Math.Min(s.PointAtParameter(0,0).X, s.PointAtParameter(0,1).X)
    a2 = Math.Min(s.PointAtParameter(1,0).X, s.PointAtParameter(1,1).X)
    return Math.Min(a1, a2)

def GetSurfaceMaxX(s):
    a1 = Math.Max(s.PointAtParameter(0,0).X, s.PointAtParameter(0,1).X)
    a2 = Math.Max(s.PointAtParameter(1,0).X, s.PointAtParameter(1,1).X)
    return Math.Max(a1, a2)

def GetSurfaceMinY(s):
    a1 = Math.Min(s.PointAtParameter(0,0).Y, s.PointAtParameter(0,1).Y)
    a2 = Math.Min(s.PointAtParameter(1,0).Y, s.PointAtParameter(1,1).Y)
    return Math.Min(a1, a2)

def GetSurfaceMaxY(s):
    a1 = Math.Max(s.PointAtParameter(0,0).Y, s.PointAtParameter(0,1).Y)
    a2 = Math.Max(s.PointAtParameter(1,0).Y, s.PointAtParameter(1,1).Y)
    return Math.Max(a1, a2)


class SortByMinX(object):
     def __init__(self, val):
         self.val = val

     def __lt__(self, other):
         return GetSurfaceMinX(self.val) < GetSurfaceMinX(other.val)

class SortByMinY(object):
     def __init__(self, val):
         self.val = val

     def __lt__(self, other):
         return GetSurfaceMinY(self.val) < GetSurfaceMinY(other.val)


def CreateXCheckerSurface(s):
    minX = GetSurfaceMinX(s)
    minY = GetSurfaceMinY(s)
    maxX = GetSurfaceMaxX(s)
    maxY = GetSurfaceMaxY(s)
    minZ = s.PointAtParameter(0,0).Z
    pl = [
            Point.ByCoordinates(minX - 100000, minY + 0.1, minZ),
            Point.ByCoordinates(minX - 100000, maxY - 0.1, minZ),
            Point.ByCoordinates(minX, maxY - 0.1, minZ),
            Point.ByCoordinates(minX, minY + 0.1, minZ),
        ]

    checkerX = Surface.ByPerimeterPoints(pl)

    return checkerX

def CreateYCheckerSurface(s):
    minX = GetSurfaceMinX(s)
    minY = GetSurfaceMinY(s)
    maxX = GetSurfaceMaxX(s)
    maxY = GetSurfaceMaxY(s)
    minZ = s.PointAtParameter(0,0).Z
    pl = [
            Point.ByCoordinates(minX + 0.1, minY - 100000, minZ),
            Point.ByCoordinates(minX + 0.1, minY, minZ),
            Point.ByCoordinates(maxX - 0.1, minY, minZ),
            Point.ByCoordinates(maxX - 0.1, minY - 100000, minZ),
        ]

    checkerX = Surface.ByPerimeterPoints(pl)

    return checkerX

def GetDistanceXToMove(s, sl):
    checkerX = CreateXCheckerSurface(s)

    cl = []

    noHit = True

    for si in sl:
        if si == s:
            continue
        else:
            if checkerX.DoesIntersect(si) == True:
                noHit = False

                cl.append(si.PointAtParameter(0,0).X)
                cl.append(si.PointAtParameter(0,1).X)
                cl.append(si.PointAtParameter(1,0).X)
                cl.append(si.PointAtParameter(1,1).X)

    if noHit == True:
        return - GetSurfaceMinX(s)
    else:
        cl.sort(reverse=True)
        return cl[0] - GetSurfaceMinX(s)

def GetDistanceYToMove(s, sl):
    checkerY = CreateYCheckerSurface(s)

    cl = []

    noHit = True

    for si in sl:
        if si == s:
            continue
        else:
            if checkerY.DoesIntersect(si) == True:
                noHit = False

                cl.append(si.PointAtParameter(0,0).Y)
                cl.append(si.PointAtParameter(0,1).Y)
                cl.append(si.PointAtParameter(1,0).Y)
                cl.append(si.PointAtParameter(1,1).Y)

    if noHit == True:
        return - GetSurfaceMinY(s)
    else:
        cl.sort(reverse=True)
        return cl[0] - GetSurfaceMinY(s)


def MoveX():
    xOrdered = GetXOrderSurfaces(surfacelist)

    for s in xOrdered:    
        toMoveX = GetDistanceXToMove(s, surfacelist)
        idx = GetIndexOfSurface(s, surfacelist)
        surfacelist[idx] = Geometry.Translate(surfacelist[idx], toMoveX, 0, 0)

def MoveY():
    yOrdered = GetYOrderSurfaces(surfacelist)

    for s in yOrdered:
        toMoveY = GetDistanceYToMove(s, surfacelist)
        idx = GetIndexOfSurface(s, surfacelist)
        surfacelist[idx] = Geometry.Translate(surfacelist[idx], 0, toMoveY, 0)

def SplitX():
    xOrdered = GetXOrderSurfaces(surfacelist)

    offsetX = 0   
    for i in range(0, len(xOrdered)):
        idx = GetIndexOfSurface(xOrdered[i], surfacelist)

        mx = offsetX - GetSurfaceMinX(surfacelist[idx])
        surfacelist[idx] = Geometry.Translate(surfacelist[idx], mx, 0, 0)

        sx = GetSurfaceMaxX(surfacelist[idx]) - GetSurfaceMinX(surfacelist[idx])
        offsetX = offsetX + sx

def SplitY():
    yOrdered = GetYOrderSurfaces(surfacelist)

    offsetY = 0   
    for i in range(0, len(yOrdered)):
        idx = GetIndexOfSurface(yOrdered[i], surfacelist)

        my = offsetY - GetSurfaceMinY(surfacelist[idx])
        surfacelist[idx] = Geometry.Translate(surfacelist[idx], 0, my, 0)

        sy = GetSurfaceMaxY(surfacelist[idx]) - GetSurfaceMinY(surfacelist[idx])
        offsetY = offsetY + sy

def MinofAll():
    allX = []
    allY = []
    for s in surfacelist:
        allX.append(GetSurfaceMinX(s))
        allY.append(GetSurfaceMinY(s))
    allX.sort()
    allY.sort()
    x = 0
    if allX[0] < 0:
        x = -allX[0]
    y = 0
    if allY[0] < 0:
        y = -allY[0]

    return x,y



# 이 노드에 대한 입력값은 IN 변수에 리스트로 저장됩니다.
dataEnteringNode = IN

# 코드를 이 선 아래에 배치

surfaces = IN[0]

surfaceLists = []
for sl in surfaces:
    tmps = []
    for s in sl:
        tmps.append(s)
    surfaceLists.append(tmps)

surfacelist = []


for l in range(0, len(surfaceLists)):
    surfacelist = surfaceLists[l]
# for s in surfaces:
#     surfacelist.append(s)

    (basX, basY) = MinofAll()
    for i in range(0, len(surfacelist)):
        surfacelist[i] = Geometry.Translate(surfacelist[i], basX, basY, 0)

    if randint(0, 1) == 0:
        SplitX()
        MoveX()
        MoveY()
        MoveX()
        MoveY()
    else:
        SplitY()
        MoveY()
        MoveX()
        MoveY()
        MoveX()

# testnum = IN[1]
# xOrdered = GetXOrderSurfaces(surfacelist)

# # for s in xOrdered:    
# toMoveX = GetDistanceXToMove(xOrdered[testnum], surfacelist)
# idx = GetIndexOfSurface(xOrdered[testnum], surfacelist)
# surfacelist[idx] = Geometry.Translate(surfacelist[idx], toMoveX, 0, 0)



# 출력을 OUT 변수에 지정합니다.
OUT = surfaceLists
# ----------------------------------------
# note: 2
python_script_4 = Python()  # IronPython2; unwired: IN[0]; same code as python_script_3
