# Dynamo graph test 0824-1.dyn (Dynamo 2.10.1.3976)

code_block = CodeBlock { 10; 20; }
byWidthLength = Rectangle.ByWidthLength(width=code_block.out0, length=code_block.out1)
code_block_2 = CodeBlock { 5..15..5; }
byWidthLength_2 = Rectangle.ByWidthLength(width=code_block_2, length=code_block_2)
code_block_3 = CodeBlock { 10; }
code_block_4 = CodeBlock { 10; }
code_block_5 = CodeBlock { 10; }
number_slider = DoubleSlider(-39.784, range=-39.784..100 step 0.1)
number_slider_2 = DoubleSlider(-50.301, range=-50.301..100 step 0.1)
byCoordinates = Point.ByCoordinates(x=number_slider, y=number_slider_2)
X = Point.X(point=byCoordinates)
Y = Point.Y(point=byCoordinates)
byOrigin = CoordinateSystem.ByOrigin(x=X, y=Y)
code_block_6 = CodeBlock { 5..15..5; }
byWidthLength_3 = Rectangle.ByWidthLength(cs=byOrigin, width=code_block_6, length=code_block_6)
code_block_7 = CodeBlock(a=byWidthLength_3) { a[0]; a[1]; a[2]; }
code_block_8 = CodeBlock { 10; }
translate = Geometry.Translate(geometry=code_block_7.out0, xTranslation=code_block_8)
code_block_9 = CodeBlock { 12.5; }
translate_2 = Geometry.Translate(geometry=code_block_7.out1, yTranslation=code_block_9)
translate_3 = Geometry.Translate(geometry=code_block_7.out2)
join = List.Join(list0=translate, list1=translate_2, list2=translate_3)
number_slider_3 = DoubleSlider(55.272, range=0..100 step 0.1)
number_slider_4 = DoubleSlider(-1.642, range=-1.642..100 step 0.1)
byCoordinates_2 = Point.ByCoordinates(x=number_slider_3, y=number_slider_4)
X_2 = Point.X(point=byCoordinates_2)
Y_2 = Point.Y(point=byCoordinates_2)
byOrigin_2 = CoordinateSystem.ByOrigin(x=X_2, y=Y_2)
code_block_10 = CodeBlock { 5..15..5; }
byWidthLength_4 = Rectangle.ByWidthLength(cs=byOrigin_2, width=code_block_10, length=code_block_10)
code_block_11 = CodeBlock(a=byWidthLength_4) { a[0]; a[1]; a[2]; }
code_block_12 = CodeBlock { 10; }
translate_4 = Geometry.Translate(geometry=code_block_11.out0, xTranslation=code_block_12)
code_block_13 = CodeBlock { 12.5; }
translate_5 = Geometry.Translate(geometry=code_block_11.out1, yTranslation=code_block_13)
translate_6 = Geometry.Translate(geometry=code_block_11.out2)
join_2 = List.Join(list0=translate_4, list1=translate_5, list2=translate_6)
ZAxis = Vector.ZAxis()
code_block_14 = CodeBlock { 90; }
rotate = Geometry.Rotate(geometry=join_2, origin=byCoordinates_2, axis=ZAxis, degrees=code_block_14)
number_slider_5 = DoubleSlider(7.227, range=0..100 step 0.1)
number_slider_6 = DoubleSlider(-31.014, range=-31.077..100 step 0.1)
byCoordinates_3 = Point.ByCoordinates(x=number_slider_5, y=number_slider_6)
X_3 = Point.X(point=byCoordinates_3)
Y_3 = Point.Y(point=byCoordinates_3)
byOrigin_3 = CoordinateSystem.ByOrigin(x=X_3, y=Y_3)
code_block_15 = CodeBlock { 5..15..5; }
byWidthLength_5 = Rectangle.ByWidthLength(cs=byOrigin_3, width=code_block_15, length=code_block_15)
code_block_16 = CodeBlock(a=byWidthLength_5) { a[0]; a[1]; a[2]; }
code_block_17 = CodeBlock { 10; }
translate_7 = Geometry.Translate(geometry=code_block_16.out0, xTranslation=code_block_17)
code_block_18 = CodeBlock { 12.5; }
translate_8 = Geometry.Translate(geometry=code_block_16.out1, yTranslation=code_block_18)
translate_9 = Geometry.Translate(geometry=code_block_16.out2)
join_3 = List.Join(list0=translate_7, list1=translate_8, list2=translate_9)
ZAxis_2 = Vector.ZAxis()
code_block_19 = CodeBlock { 180; }
rotate_2 = Geometry.Rotate(geometry=join_3, origin=byCoordinates_3, axis=ZAxis_2, degrees=code_block_19)
join_4 = List.Join(list0=join, list1=rotate, list2=rotate_2)
explode = Geometry.Explode(geometry=join_4)
flatten = List.Flatten(list=explode)
explode_2 = Geometry.Explode(geometry=join)
startPoint = Curve.StartPoint(curve=explode_2)
flatten_2 = List.Flatten(list=startPoint)
python_script = Python(IN[0]=flatten_2)  # IronPython2
# ---------- python_script.python (55 lines) ----------
import clr
clr.AddReference('ProtoGeometry')
from Autodesk.DesignScript.Geometry import *

def ToVals(pt):
           return [pt.X,pt.Y,pt.Z]

def ToPts(ptVals):
           return Point.ByCoordinates(ptVals[0],ptVals[1],ptVals[2])

def CreateOutline(pts):
           crvs = []
           i = 0
           while i < len(pts):
                     if i == len(pts)-1:
                                crvs.append(Line.ByStartPointEndPoint(pts[i],pts[0]))
                     else:
                                crvs.append(Line.ByStartPointEndPoint(pts[i],pts[i+1]))
                     i = i+1
           return PolyCurve.ByJoinedCurves(crvs)

'''
Taken from Thomas Switzers awesome GitHub repo and modified to suit Dynamo Context
https://gist.github.com/arthur-e/5cf52962341310f438e96c1f3c3398b8
I take zero credit for this work other than porting it across.
'''
def convex_hull_graham(points):
           '''
           Returns points on convex hull in CCW order according to Graham's scan algorithm. 
           By Tom Switzer <thomas.switzer@gmail.com>.
           '''
           TURN_LEFT, TURN_RIGHT, TURN_NONE = (1, -1, 0)

           def cmp(a, b):
                     return (a > b) - (a < b)
           
           def turn(p, q, r):
                     return cmp((q[0] - p[0])*(r[1] - p[1]) - (r[0] - p[0])*(q[1] - p[1]), 0)
           
           def _keep_left(hull, r):
                     while len(hull) > 1 and turn(hull[-2], hull[-1], r) != TURN_LEFT:
                                hull.pop()
                     if not len(hull) or hull[-1] != r:
                                hull.append(r)
                     return hull

           points = [ToVals(p) for p in points] 
           points = sorted(points)
           l = reduce(_keep_left, points, [])
           u = reduce(_keep_left, reversed(points), [])
           points = l.extend(u[i] for i in range(1, len(u) - 1)) or l
           points = [ToPts(p) for p in points]
           return CreateOutline(points)

OUT = convex_hull_graham(IN[0])
# ----------------------------------------
explode_3 = Geometry.Explode(geometry=rotate)
startPoint_2 = Curve.StartPoint(curve=explode_3)
flatten_3 = List.Flatten(list=startPoint_2)
python_script_2 = Python(IN[0]=flatten_3)  # IronPython2; same code as python_script
explode_4 = Geometry.Explode(geometry=rotate_2)
startPoint_3 = Curve.StartPoint(curve=explode_4)
flatten_4 = List.Flatten(list=startPoint_3)
python_script_3 = Python(IN[0]=flatten_4)  # IronPython2; same code as python_script
join_5 = List.Join(list0=python_script, list1=python_script_2, list2=python_script_3)
explode_5 = Geometry.Explode(geometry=join_5)
reverse = Vector.Reverse()  # unwired: vector
code_block_20 = CodeBlock { 2; }
translate_10 = Geometry.Translate(direction=reverse, distance=code_block_20)  # unwired: geometry
byCoordinates_4 = Point.ByCoordinates()
watch = Watch(byCoordinates)
watch_2 = Watch(byCoordinates_2)
watch_3 = Watch(byCoordinates_3)
join_6 = List.Join(list0=watch, list1=watch_2, list2=watch_3)
byStartPointEndPoint = Line.ByStartPointEndPoint(startPoint=byCoordinates_4, endPoint=join_6)
direction = Line.Direction(line=byStartPointEndPoint)
X_4 = Vector.X(vector=direction)
abs = Math.Abs(number=X_4)
Y_4 = Vector.Y(vector=direction)
abs_2 = Math.Abs(number=Y_4)
gt = abs > abs_2
byCoordinates_5 = Vector.ByCoordinates(x=X_4)
byCoordinates_6 = Vector.ByCoordinates(y=Y_4)
if_ = If(test=gt, true=byCoordinates_5, false=byCoordinates_6)
byPatch = Surface.ByPatch(closedCurve=join)
byJoinedSurfaces = PolySurface.ByJoinedSurfaces(surfaces=byPatch)
perimeterCurves = Surface.PerimeterCurves(surface=byJoinedSurfaces)
byPatch_2 = Surface.ByPatch(closedCurve=rotate)
byJoinedSurfaces_2 = PolySurface.ByJoinedSurfaces(surfaces=byPatch_2)
perimeterCurves_2 = Surface.PerimeterCurves(surface=byJoinedSurfaces_2)
byPatch_3 = Surface.ByPatch(closedCurve=rotate_2)
byJoinedSurfaces_3 = PolySurface.ByJoinedSurfaces(surfaces=byPatch_3)
perimeterCurves_3 = Surface.PerimeterCurves(surface=byJoinedSurfaces_3)
join_7 = List.Join(list0=perimeterCurves, list1=perimeterCurves_2, list2=perimeterCurves_3)
doesIntersect = Geometry.DoesIntersect(geometry=byStartPointEndPoint, other=join_7, lacing=CrossProduct)
filterByBoolMask = List.FilterByBoolMask(list=join_7, mask=doesIntersect@L2)
watch_4 = Watch(filterByBoolMask.in)
watch_5 = Watch(perimeterCurves)
flatten_5 = List.Flatten(list=filterByBoolMask.in)
code_block_21 = CodeBlock { 2; }
offset = Curve.Offset(curve=flatten_5, distance=code_block_21)
code_block_22 = CodeBlock(i=offset) { i[0]; }
byJoinedCurves = PolyCurve.ByJoinedCurves(curves=perimeterCurves)
join_8 = List.Join(list0=code_block_22, list1=byJoinedCurves)
byJoinedCurves_2 = PolyCurve.ByJoinedCurves(curves=join_8)
surfaces = PolySurface.Surfaces(polySurface=byJoinedSurfaces_2)
