# Dynamo graph 0831 (동훈팀장님2) space planning test_mk_수정(2).dyn "0831 (동훈팀장님) space planning test_mk_수정(2)" (Dynamo 2.10.1.3976)
# packages: GenerativeDesign.Revit 1.7.3.0, GenerativeDesign 1.7.3.0, Refinery Toolkit 1.1.1

# group: User Inputs for GDIR
# note: Custom Package: GenerativeDesign v.2021.5.5
select_room_to_load_program_into = DSModelRoomSelection()  # 1 picked in the model; graph input
# note: Retrieve the room's finish boundary.
# Note: The first sublist is the outermost boundary of the room.
finishBoundary = Room.FinishBoundary(room=select_room_to_load_program_into)
remember = Data.Remember(finishBoundary)

# group: Extract room boundary for DynaSpace and cache it in the graph
firstItem = List.FirstItem(list=remember@L3)
startPoint = Curve.StartPoint(curve=firstItem)
flatten = List.Flatten(list=startPoint)
byJoinedCurves = PolyCurve.ByJoinedCurves(curves=firstItem)
code_block = CodeBlock(BldgBoundary=byJoinedCurves)
# ---------- code_block.designscript (3 lines) ----------
{
"BldgBoundary": _BldgBoundary
};
# ----------------------------------------

# group: 고정부 Seed
seed_고정부_코어 = DoubleSlider(673, range=0..999 step 1)  # graph input

# group: 변동부 Seed
seed_변형부_공간 = DoubleSlider(384, range=0..999 step 1)  # graph input

# group: 회전 Seed
seed_회전용 = DoubleSlider(379, range=0..999 step 1)  # graph input

# group: Floor Level
code_block_2 = CodeBlock { [-6000, 0, 6000, 12000]; }

code_block_3 = CodeBlock(FixedPartSeed=seed_고정부_코어, NonFixedPartSeed=seed_변형부_공간, RotatingSeed=seed_회전용, FloorLevel=code_block_2)
# ---------- code_block_3.designscript (6 lines) ----------
{
"FixedPartSeed": _FixedPartSeed,
"NonFixedPartSeed": _NonFixedPartSeed,
"RotatingSeed": _RotatingSeed,
"FloorLevel": _FloorLevel
};
# ----------------------------------------
extendsChildDictionaryFromParent = Custom[ExtendsChildDictionaryFromParent](ParentDic=code_block, ChildDic=code_block_3)  # Extends Child Dictionary From Parent

# group: Excel Data import (package 정리 전)
file_path = Filename("상상진화\20210824\space planning test 0802mk 001.xlsx")
file_from_path = FileObject(path=file_path)
string_from_object = FromObject(object=file_from_path)
code_block_4 = CodeBlock { "Sheet1"; "SampleBuildingProgram-Clinic"; false; }
python_script_import_excel_by = Python(IN[0]=string_from_object, IN[1]=code_block_4.out0)  # "Python Script@Import Excel(By OpenpyXl)"; CPython3
# ---------- python_script_import_excel_by.python (50 lines) ----------
# Load the Python Standard and DesignScript Libraries
import sys
import os
#sys.path.append(r'C:\Users\HEC\AppData\Local\Programs\Python\Python39\Lib\site-packages')
#sys.path.append(r'C:\Users\pjmk0\AppData\Local\Programs\Python\Python39\Lib\site-packages')
sys.path.append(os.getenv('LOCALAPPDATA').replace('\\','\\\\') + r'\Programs\Python\Python39\Lib\site-packages')
import clr
clr.AddReference('ProtoGeometry')
from Autodesk.DesignScript.Geometry import *
from collections import Iterable

def iterable(obj):
    return isinstance(obj, Iterable)


# The inputs to this node will be stored as a list in the IN variables.
dataEnteringNode = IN
PathIn = IN[0]
SheetNameIn = IN[1]

# Place your code below this line
import datetime
import openpyxl

path = (PathIn)
#path = (r'C:\Users\pjmk0\Downloads\MK\mQ\BIM_물량집계 자동화 산출기준표_rC(20210607)_mk_de.xlsx')

wb_obj = openpyxl.load_workbook(path, data_only=True)
sheet_obj = wb_obj.get_sheet_by_name(SheetNameIn)

m_row = sheet_obj.max_row
m_col = sheet_obj.max_column

listOut = []



for i in range(1, m_row +1):
    listTemp = []
    for j in range(1, m_col + 1):
        cell_obj = sheet_obj.cell(row=i, column=j)
        listTemp.append(cell_obj.value)
        if len(listTemp) == m_col:
            listOut.append(listTemp)
        


# Assign your output to the OUT variable.
OUT = listOut
#OUT = os.getenv('APPDATA')
# ----------------------------------------
excel_data_정리_전 = Watch(python_script_import_excel_by)

remember_2 = Data.Remember(excel_data_정리_전)

# group: Excel List 분할
excel_data_정리_전_2 = Watch(remember_2)
transpose = List.Transpose(lists=excel_data_정리_전_2)
# note: List Name 정리
code_block_5 = CodeBlock { 1; }
dropItems = List.DropItems(list=transpose@L2, amount=code_block_5)
watch = Watch(dropItems)
code_block_6 = CodeBlock { 0; }
getItemAtIndex = List.GetItemAtIndex(list=watch, index=code_block_6)
space_id = Watch(getItemAtIndex)
code_block_7 = CodeBlock { 1; }
getItemAtIndex_2 = List.GetItemAtIndex(list=watch, index=code_block_7)
space_name = Watch(getItemAtIndex_2)
code_block_8 = CodeBlock { 10; }
getItemAtIndex_3 = List.GetItemAtIndex(list=watch, index=code_block_8)
adjacent_spaces = Watch(getItemAtIndex_3)
code_block_9 = CodeBlock { 3; }
getItemAtIndex_4 = List.GetItemAtIndex(list=watch, index=code_block_9)
department_id = Watch(getItemAtIndex_4)
code_block_10 = CodeBlock { 2; }
getItemAtIndex_5 = List.GetItemAtIndex(list=watch, index=code_block_10)
DEPARTMENT = Watch(getItemAtIndex_5)
code_block_11 = CodeBlock { 11; }
getItemAtIndex_6 = List.GetItemAtIndex(list=watch, index=code_block_11)
lev = Watch(getItemAtIndex_6)
code_block_12 = CodeBlock { 5; }
getItemAtIndex_7 = List.GetItemAtIndex(list=watch, index=code_block_12)
WIDTH = Watch(getItemAtIndex_7)
code_block_13 = CodeBlock { 6; }
getItemAtIndex_8 = List.GetItemAtIndex(list=watch, index=code_block_13)
length = Watch(getItemAtIndex_8)
code_block_14 = CodeBlock { 7; }
getItemAtIndex_9 = List.GetItemAtIndex(list=watch, index=code_block_14)
height = Watch(getItemAtIndex_9)
code_block_15 = CodeBlock { 8; }
getItemAtIndex_10 = List.GetItemAtIndex(list=watch, index=code_block_15)
AREA = Watch(getItemAtIndex_10)
code_block_16 = CodeBlock { 14; }
getItemAtIndex_11 = List.GetItemAtIndex(list=watch, index=code_block_16)
ROTATE = Watch(getItemAtIndex_11)
code_block_17 = CodeBlock { 15; }
getItemAtIndex_12 = List.GetItemAtIndex(list=watch, index=code_block_17)
CLUSTER = Watch(getItemAtIndex_12)
code_block_18 = CodeBlock(ExcelDataWithNoHead=watch, SpaceID=space_id, SpaceName=space_name, AdjacentSpaces=adjacent_spaces, DepartmentID=department_id, Department=DEPARTMENT, Level=lev, Width=WIDTH, Length=length, Height=height, Area=AREA, Rotate=ROTATE, Cluster=CLUSTER)
# ---------- code_block_18.designscript (15 lines) ----------
{
"ExcelDataWithNoHead": _ExcelDataWithNoHead,
"SpaceID": _SpaceID,
"SpaceName": _SpaceName,
"AdjacentSpaces": _AdjacentSpaces,
"DepartmentID": _DepartmentID,
"Department": _Department,
"Level": _Level,
"Width": _Width,
"Length": _Length,
"Height": _Height,
"Area": _Area,
"Rotate": _Rotate,
"Cluster": _Cluster
};
# ----------------------------------------

code_block_19 = CodeBlock(InputDic=code_block_18) { _InputDic; }
code_block_20 = CodeBlock { "SpaceID"; }
valueAtKey = DesignScript.Builtin.Dictionary.ValueAtKey(dictionary=code_block_19, key=code_block_20)
code_block_21 = CodeBlock { "SpaceName"; }
valueAtKey_2 = DesignScript.Builtin.Dictionary.ValueAtKey(dictionary=code_block_19, key=code_block_21)
code_block_22 = CodeBlock { "AdjacentSpaces"; }
valueAtKey_3 = DesignScript.Builtin.Dictionary.ValueAtKey(dictionary=code_block_19, key=code_block_22)
code_block_23 = CodeBlock { "DepartmentID"; }
valueAtKey_4 = DesignScript.Builtin.Dictionary.ValueAtKey(dictionary=code_block_19, key=code_block_23)
code_block_24 = CodeBlock { "Department"; }
valueAtKey_5 = DesignScript.Builtin.Dictionary.ValueAtKey(dictionary=code_block_19, key=code_block_24)
code_block_25 = CodeBlock { "Level"; }
valueAtKey_6 = DesignScript.Builtin.Dictionary.ValueAtKey(dictionary=code_block_19, key=code_block_25)
code_block_26 = CodeBlock { "Width"; }
valueAtKey_7 = DesignScript.Builtin.Dictionary.ValueAtKey(dictionary=code_block_19, key=code_block_26)
code_block_27 = CodeBlock { "Length"; }
valueAtKey_8 = DesignScript.Builtin.Dictionary.ValueAtKey(dictionary=code_block_19, key=code_block_27)
code_block_28 = CodeBlock { "Height"; }
valueAtKey_9 = DesignScript.Builtin.Dictionary.ValueAtKey(dictionary=code_block_19, key=code_block_28)
code_block_29 = CodeBlock { "Area"; }
valueAtKey_10 = DesignScript.Builtin.Dictionary.ValueAtKey(dictionary=code_block_19, key=code_block_29)
code_block_30 = CodeBlock { "Rotate"; }
valueAtKey_11 = DesignScript.Builtin.Dictionary.ValueAtKey(dictionary=code_block_19, key=code_block_30)
code_block_31 = CodeBlock { "Cluster"; }
valueAtKey_12 = DesignScript.Builtin.Dictionary.ValueAtKey(dictionary=code_block_19, key=code_block_31)
code_block_32 = CodeBlock(BoxSpaceID=valueAtKey, BoxSpaceName=valueAtKey_2, BoxAdjacentSpaces=valueAtKey_3, BoxDepartmentID=valueAtKey_4, BoxDepartment=valueAtKey_5, BoxLevel=valueAtKey_6, BoxWidth=valueAtKey_7, BoxLength=valueAtKey_8, BoxHeight=valueAtKey_9, BoxArea=valueAtKey_10, BoxRotate=valueAtKey_11, BoxCluster=valueAtKey_12)
# ---------- code_block_32.designscript (15 lines) ----------
///Box Class Primary
{
"BoxSpaceID": _BoxSpaceID,
"BoxSpaceName": _BoxSpaceName,
"BoxAdjacentSpaces": _BoxAdjacentSpaces,
"BoxDepartmentID": _BoxDepartmentID,
"BoxDepartment": _BoxDepartment,
"BoxLevel": _BoxLevel,
"BoxWidth": _BoxWidth,
"BoxLength": _BoxLength,
"BoxHeight": _BoxHeight,
"BoxArea": _BoxArea,
"BoxRotate": _BoxRotate,
"BoxCluster": _BoxCluster
};
# ----------------------------------------
code_block_33 = CodeBlock(BoxClass_Primary=code_block_32)
# ---------- code_block_33.designscript (3 lines) ----------
{
"BoxClass_Primary": _BoxClass_Primary
};
# ----------------------------------------
extendsChildDictionaryFromParent_2 = Custom[ExtendsChildDictionaryFromParent](ParentDic=extendsChildDictionaryFromParent.dictionary, ChildDic=code_block_33)
watch_2 = Watch(extendsChildDictionaryFromParent_2.key)
code_block_34 = CodeBlock(InputDic=extendsChildDictionaryFromParent_2.dictionary) { _InputDic; }
setBoxZvalueProp = Custom[SetBoxZvalueProp](InputDic=code_block_34)  # SetBoxZvalueProp

# group: 룸 BoundingBox 그리드 포인트 생성
code_block_35 = CodeBlock(InputDic=setBoxZvalueProp) { _InputDic; }
code_block_36 = CodeBlock { "BldgBoundary"; }
valueAtKey_13 = DesignScript.Builtin.Dictionary.ValueAtKey(dictionary=code_block_35, key=code_block_36)
byGeometry = BoundingBox.ByGeometry(geom=valueAtKey_13)
minPoint = BoundingBox.MinPoint(boundingBox=byGeometry)
X = Point.X(point=minPoint)
maxPoint = BoundingBox.MaxPoint(boundingBox=byGeometry)
X_2 = Point.X(point=maxPoint)
code_block_37 = CodeBlock { 500; }
code_block_38 = CodeBlock(a=X, b=X_2, x=code_block_37) { a..b..x; }
Y = Point.Y(point=minPoint)
Y_2 = Point.Y(point=maxPoint)
code_block_39 = CodeBlock { 500; }
code_block_40 = CodeBlock(a=Y, b=Y_2, x=code_block_39) { a..b..x; }
byCoordinates = Point.ByCoordinates(x=code_block_38, y=code_block_40, lacing=CrossProduct)
flatten_2 = List.Flatten(list=byCoordinates)
code_block_41 = CodeBlock(GridPointOfBldgBoundary=flatten_2)
# ---------- code_block_41.designscript (3 lines) ----------
{
"GridPointOfBldgBoundary": _GridPointOfBldgBoundary
};
# ----------------------------------------
extendsChildDictionaryFromParent_3 = Custom[ExtendsChildDictionaryFromParent](ParentDic=code_block_35, ChildDic=code_block_41)

distributeRandomSeedForFixedPart = Custom[DistributeRandomSeedForFixedPart](InputDic=extendsChildDictionaryFromParent_3.dictionary)  # DistributeRandomSeedForFixedPart

# group: Fixed Part 형상 배치 by Seed(회전 고려)
code_block_42 = CodeBlock(InputDic=distributeRandomSeedForFixedPart) { _InputDic; }
code_block_43 = CodeBlock { "BoxClass_fixedpart"; }
valueAtKey_14 = DesignScript.Builtin.Dictionary.ValueAtKey(dictionary=code_block_42, key=code_block_43)
code_block_44 = CodeBlock { "BoxZvalue"; }
valueAtKey_15 = DesignScript.Builtin.Dictionary.ValueAtKey(dictionary=valueAtKey_14, key=code_block_44)
uniqueItems = List.UniqueItems(list=valueAtKey_15)
code_block_45 = CodeBlock { "BoxClass_fixedpart"; }
code_block_46 = CodeBlock { "BoxGeometry"; }
components = DesignScript.Builtin.Dictionary.Components(dictionary=valueAtKey_14)
addItemToEnd = List.AddItemToEnd(item=code_block_46, list=components.keys)
code_block_47 = CodeBlock { "GridPointOfBldgBoundary"; }
valueAtKey_16 = DesignScript.Builtin.Dictionary.ValueAtKey(dictionary=code_block_42, key=code_block_47)
code_block_48 = CodeBlock { "BoxSeed"; }
valueAtKey_17 = DesignScript.Builtin.Dictionary.ValueAtKey(dictionary=valueAtKey_14, key=code_block_48)
getItemAtIndex_13 = List.GetItemAtIndex(list=valueAtKey_16, index=valueAtKey_17)
X_3 = Point.X(point=getItemAtIndex_13)
Y_3 = Point.Y(point=getItemAtIndex_13)
firstItem_2 = List.FirstItem(list=valueAtKey_15)
code_block_49 = CodeBlock(i=valueAtKey_15, j=firstItem_2) { i+Math.Abs(j/2); }
byCoordinates_2 = Point.ByCoordinates(x=X_3, y=Y_3, z=code_block_49)
code_block_50 = CodeBlock { "BoxWidth"; }
valueAtKey_18 = DesignScript.Builtin.Dictionary.ValueAtKey(dictionary=valueAtKey_14, key=code_block_50)
code_block_51 = CodeBlock { "BoxLength"; }
valueAtKey_19 = DesignScript.Builtin.Dictionary.ValueAtKey(dictionary=valueAtKey_14, key=code_block_51)
code_block_52 = CodeBlock { "BoxHeight"; }
valueAtKey_20 = DesignScript.Builtin.Dictionary.ValueAtKey(dictionary=valueAtKey_14, key=code_block_52)
byLengths = Cuboid.ByLengths(origin=byCoordinates_2, width=valueAtKey_18, length=valueAtKey_19, height=valueAtKey_20)
centroid = Solid.Centroid(solid=byLengths)
ZAxis = Vector.ZAxis()
code_block_53 = CodeBlock { "BoxClass_Primary"; }
valueAtKey_21 = DesignScript.Builtin.Dictionary.ValueAtKey(dictionary=code_block_42, key=code_block_53)
code_block_54 = CodeBlock { "BoxDepartment"; }
valueAtKey_22 = DesignScript.Builtin.Dictionary.ValueAtKey(dictionary=valueAtKey_21, key=code_block_54)
code_block_55 = CodeBlock()
# ---------- code_block_55.designscript (6 lines) ----------
[
"PATHV1",
"PATHV2",
"PATHV3"
];
[];
# ----------------------------------------
contains = String.Contains(str=valueAtKey_22, searchFor=code_block_55.out0@@L1)
boolean = BoolSelector(true)
allIndicesOf = List.AllIndicesOf(list=contains@@L2, item=boolean)
count = List.Count(list=allIndicesOf)
code_block_56 = CodeBlock { 0; }
code_block_57 = CodeBlock { 90; }
code_block_58 = CodeBlock { "RotatingSeed"; }
valueAtKey_23 = DesignScript.Builtin.Dictionary.ValueAtKey(dictionary=code_block_42, key=code_block_58)
randomList = Math.RandomList(amount=count, value1=code_block_56, value2=code_block_57, seed=valueAtKey_23)
code_block_59 = CodeBlock(i=randomList) { i>=45; }
code_block_60 = CodeBlock { 90; 0; }
if_ = If(test=code_block_59, true=code_block_60.out0, false=code_block_60.out1)
count_2 = List.Count(list=allIndicesOf@L2)
ofRepeatedItem = List.OfRepeatedItem(item=if_@L1, amount=count_2@L1)
flatten_3 = List.Flatten(list=ofRepeatedItem)
rotate = Geometry.Rotate(geometry=byLengths, origin=centroid, axis=ZAxis, degrees=flatten_3)
addItemToEnd_2 = List.AddItemToEnd(item=rotate, list=components.values)
byKeysValues = DesignScript.Builtin.Dictionary.ByKeysValues(keys=addItemToEnd, values=addItemToEnd_2)
setValueAtKeys = DesignScript.Builtin.Dictionary.SetValueAtKeys(dictionary=code_block_42, keys=code_block_45, values=byKeysValues)

# group: 레벨 별 고정부 비점유 포인트 추출
code_block_61 = CodeBlock(InputDic=setValueAtKeys) { _InputDic; }
code_block_62 = CodeBlock { "GridPointOfBldgBoundary"; }
valueAtKey_24 = DesignScript.Builtin.Dictionary.ValueAtKey(dictionary=code_block_61, key=code_block_62)
X_4 = Point.X(point=valueAtKey_24)
Y_4 = Point.Y(point=valueAtKey_24)
code_block_63 = CodeBlock { "BoxClass_fixedpart"; }
valueAtKey_25 = DesignScript.Builtin.Dictionary.ValueAtKey(dictionary=code_block_61, key=code_block_63)
code_block_64 = CodeBlock { "BoxZvalue"; }
valueAtKey_26 = DesignScript.Builtin.Dictionary.ValueAtKey(dictionary=valueAtKey_25, key=code_block_64)
uniqueItems_2 = List.UniqueItems(list=valueAtKey_26)
byCoordinates_3 = Point.ByCoordinates(x=X_4, y=Y_4, z=uniqueItems_2@L1)
code_block_65 = CodeBlock { "BoxGeometry"; }
valueAtKey_27 = DesignScript.Builtin.Dictionary.ValueAtKey(dictionary=valueAtKey_25, key=code_block_65)
byUnion = Solid.ByUnion(solids=valueAtKey_27)
doesIntersect = Geometry.DoesIntersect(geometry=byCoordinates_3, other=byUnion)
filterByBoolMask = List.FilterByBoolMask(list=byCoordinates_3@L2, mask=doesIntersect@L2)
watch_3 = Watch(filterByBoolMask.out)
code_block_66 = CodeBlock(RestGridPointByLevel=watch_3)
# ---------- code_block_66.designscript (3 lines) ----------
{
"RestGridPointByLevel": _RestGridPointByLevel
};
# ----------------------------------------
extendsChildDictionaryFromParent_4 = Custom[ExtendsChildDictionaryFromParent](ParentDic=code_block_61, ChildDic=code_block_66)

code_block_67 = CodeBlock(i=filterByBoolMask.out) { i; }
python_script = Python()  # IronPython2; frozen; unwired: IN[0]
# ---------- python_script.python (264 lines) ----------
# Python 표준 및 DesignScript 라이브러리 로드
from random import randint
import sys
import clr
clr.AddReference('ProtoGeometry')
clr.AddReference('DSCoreNodes')
from DSCore import *
from Autodesk.DesignScript.Geometry import *



def GetXOrderSurfaces(sl):
    ls = []
    for s in sl:
        ls.append(SortByMinX(s))

    ls.sort()

    r = []
    for l in ls:
        r.append(l.val)

    return r

def GetYOrderSurfaces(sl):
    ls = []
    for s in sl:
        ls.append(SortByMinY(s))

    ls.sort()

    r = []
    for l in ls:
        r.append(l.val)

    return r

def GetIndexOfSurface(s, sl):
    for i in range(0, len(sl)):
        if sl[i] == s:
            return i

def GetSurfaceMinX(s):
    a1 = Math.Min(s.PointAtParameter(0,0).X, s.PointAtParameter(0,1).X)
    a2 = Math.Min(s.PointAtParameter(1,0).X, s.PointAtParameter(1,1).X)
    return Math.Min(a1, a2)

def GetSurfaceMaxX(s):
    a1 = Math.Max(s.PointAtParameter(0,0).X, s.PointAtParameter(0,1).X)
    a2 = Math.Max(s.PointAtParameter(1,0).X, s.PointAtParameter(1,1).X)
    return Math.Max(a1, a2)

def GetSurfaceMinY(s):
    a1 = Math.Min(s.PointAtParameter(0,0).Y, s.PointAtParameter(0,1).Y)
    a2 = Math.Min(s.PointAtParameter(1,0).Y, s.PointAtParameter(1,1).Y)
    return Math.Min(a1, a2)

def GetSurfaceMaxY(s):
    a1 = Math.Max(s.PointAtParameter(0,0).Y, s.PointAtParameter(0,1).Y)
    a2 = Math.Max(s.PointAtParameter(1,0).Y, s.PointAtParameter(1,1).Y)
    return Math.Max(a1, a2)


class SortByMinX(object):
     def __init__(self, val):
         self.val = val

     def __lt__(self, other):
         return GetSurfaceMinX(self.val) < GetSurfaceMinX(other.val)

class SortByMinY(object):
     def __init__(self, val):
         self.val = val

     def __lt__(self, other):
         return GetSurfaceMinY(self.val) < GetSurfaceMinY(other.val)


def CreateXCheckerSurface(s):
    minX = GetSurfaceMinX(s)
    minY = GetSurfaceMinY(s)
    maxX = GetSurfaceMaxX(s)
    maxY = GetSurfaceMaxY(s)
    minZ = s.PointAtParameter(0,0).Z
    pl = [
            Point.ByCoordinates(minX - 100000, minY + 0.1, minZ),
            Point.ByCoordinates(minX - 100000, maxY - 0.1, minZ),
            Point.ByCoordinates(minX, maxY - 0.1, minZ),
            Point.ByCoordinates(minX, minY + 0.1, minZ),
        ]

    checkerX = Surface.ByPerimeterPoints(pl)

    return checkerX

def CreateYCheckerSurface(s):
    minX = GetSurfaceMinX(s)
    minY = GetSurfaceMinY(s)
    maxX = GetSurfaceMaxX(s)
    maxY = GetSurfaceMaxY(s)
    minZ = s.PointAtParameter(0,0).Z
    pl = [
            Point.ByCoordinates(minX + 0.1, minY - 100000, minZ),
            Point.ByCoordinates(minX + 0.1, minY, minZ),
            Point.ByCoordinates(maxX - 0.1, minY, minZ),
            Point.ByCoordinates(maxX - 0.1, minY - 100000, minZ),
        ]

    checkerX = Surface.ByPerimeterPoints(pl)

    return checkerX

def GetDistanceXToMove(s, sl):
    checkerX = CreateXCheckerSurface(s)

    cl = []

    noHit = True

    for si in sl:
        if si == s:
            continue
        else:
            if checkerX.DoesIntersect(si) == True:
                noHit = False

                cl.append(si.PointAtParameter(0,0).X)
                cl.append(si.PointAtParameter(0,1).X)
                cl.append(si.PointAtParameter(1,0).X)
                cl.append(si.PointAtParameter(1,1).X)

    if noHit == True:
        return - GetSurfaceMinX(s)
    else:
        cl.sort(reverse=True)
        return cl[0] - GetSurfaceMinX(s)

def GetDistanceYToMove(s, sl):
    checkerY = CreateYCheckerSurface(s)

    cl = []

    noHit = True

    for si in sl:
        if si == s:
            continue
        else:
            if checkerY.DoesIntersect(si) == True:
                noHit = False

                cl.append(si.PointAtParameter(0,0).Y)
                cl.append(si.PointAtParameter(0,1).Y)
                cl.append(si.PointAtParameter(1,0).Y)
                cl.append(si.PointAtParameter(1,1).Y)

    if noHit == True:
        return - GetSurfaceMinY(s)
    else:
        cl.sort(reverse=True)
        return cl[0] - GetSurfaceMinY(s)


def MoveX():
    xOrdered = GetXOrderSurfaces(surfacelist)

    for s in xOrdered:    
        toMoveX = GetDistanceXToMove(s, surfacelist)
        idx = GetIndexOfSurface(s, surfacelist)
        surfacelist[idx] = Geometry.Translate(surfacelist[idx], toMoveX, 0, 0)

def MoveY():
    yOrdered = GetYOrderSurfaces(surfacelist)

    for s in yOrdered:
        toMoveY = GetDistanceYToMove(s, surfacelist)
        idx = GetIndexOfSurface(s, surfacelist)
        surfacelist[idx] = Geometry.Translate(surfacelist[idx], 0, toMoveY, 0)

def SplitX():
    xOrdered = GetXOrderSurfaces(surfacelist)

    offsetX = 0   
    for i in range(0, len(xOrdered)):
        idx = GetIndexOfSurface(xOrdered[i], surfacelist)

        mx = offsetX - GetSurfaceMinX(surfacelist[idx])
        surfacelist[idx] = Geometry.Translate(surfacelist[idx], mx, 0, 0)

        sx = GetSurfaceMaxX(surfacelist[idx]) - GetSurfaceMinX(surfacelist[idx])
        offsetX = offsetX + sx

def SplitY():
    yOrdered = GetYOrderSurfaces(surfacelist)

    offsetY = 0   
    for i in range(0, len(yOrdered)):
        idx = GetIndexOfSurface(yOrdered[i], surfacelist)

        my = offsetY - GetSurfaceMinY(surfacelist[idx])
        surfacelist[idx] = Geometry.Translate(surfacelist[idx], 0, my, 0)

        sy = GetSurfaceMaxY(surfacelist[idx]) - GetSurfaceMinY(surfacelist[idx])
        offsetY = offsetY + sy

def MinofAll():
    allX = []
    allY = []
    for s in surfacelist:
        allX.append(GetSurfaceMinX(s))
        allY.append(GetSurfaceMinY(s))
    allX.sort()
    allY.sort()
    x = 0
    if allX[0] < 0:
        x = -allX[0]
    y = 0
    if allY[0] < 0:
        y = -allY[0]

    return x,y



# 이 노드에 대한 입력값은 IN 변수에 리스트로 저장됩니다.
dataEnteringNode = IN

# 코드를 이 선 아래에 배치

surfaces = IN[0]

surfacelist = []
for s in surfaces:
    surfacelist.append(s)

(basX, basY) = MinofAll()
for i in range(0, len(surfacelist)):
    surfacelist[i] = Geometry.Translate(surfacelist[i], basX, basY, 0)

if randint(0, 1) == 0:
    SplitX()
    MoveX()
    MoveY()
    MoveX()
    MoveY()
else:
    SplitY()
    MoveY()
    MoveX()
    MoveY()
    MoveX()

# testnum = IN[1]
# xOrdered = GetXOrderSurfaces(surfacelist)

# # for s in xOrdered:    
# toMoveX = GetDistanceXToMove(xOrdered[testnum], surfacelist)
# idx = GetIndexOfSurface(xOrdered[testnum], surfacelist)
# surfacelist[idx] = Geometry.Translate(surfacelist[idx], toMoveX, 0, 0)



# 출력을 OUT 변수에 지정합니다.
OUT = surfacelist
# ----------------------------------------
findNonFixedPartBox = Custom[FindNonFixedPartBox](InputDic=extendsChildDictionaryFromParent_4.dictionary)  # FindNonFixedPartBox
distributeRandomSeedForNonFixedPart = Custom[DistributeRandomSeedForNonFixedPart](InputDic=findNonFixedPartBox)  # DistributeRandomSeedForNonFixedPart

# group: 비 고정부 클러스터링 딕셔너리 형성
code_block_68 = CodeBlock(InputDic=distributeRandomSeedForNonFixedPart) { _InputDic; }
code_block_69 = CodeBlock { "BoxClass_nonfixedpart"; }
valueAtKey_28 = DesignScript.Builtin.Dictionary.ValueAtKey(dictionary=code_block_68, key=code_block_69)
code_block_70 = CodeBlock { "BoxCluster"; }
valueAtKey_29 = DesignScript.Builtin.Dictionary.ValueAtKey(dictionary=valueAtKey_28, key=code_block_70)
uniqueItems_3 = List.UniqueItems(list=valueAtKey_29)
list_allindicesof = List.AllIndicesOf(list=valueAtKey_29, item=uniqueItems_3)
count_3 = List.Count(list=list_allindicesof@L2)
components_2 = DesignScript.Builtin.Dictionary.Components(dictionary=valueAtKey_28)
getItemAtIndex_14 = List.GetItemAtIndex(list=components_2.values@L2, index=list_allindicesof)
byKeysValues_2 = DesignScript.Builtin.Dictionary.ByKeysValues(keys=components_2.keys, values=getItemAtIndex_14)
code_block_71 = CodeBlock(BoxClass_nonfixedclu=byKeysValues_2)
# ---------- code_block_71.designscript (3 lines) ----------
{
"BoxClass_nonfixedclustered": _BoxClass_nonfixedclustered
};
# ----------------------------------------
extendsChildDictionaryFromParent_5 = Custom[ExtendsChildDictionaryFromParent](ParentDic=code_block_68, ChildDic=code_block_71)

watch_4 = Watch(extendsChildDictionaryFromParent_5.key)

# group: 클러스터별 지오메트리 형성(랜덤회전 반영)
code_block_72 = CodeBlock(InputDic=extendsChildDictionaryFromParent_5.dictionary) { _InputDic; }
code_block_73 = CodeBlock { "BldgBoundary"; }
valueAtKey_30 = DesignScript.Builtin.Dictionary.ValueAtKey(dictionary=code_block_72, key=code_block_73)
code_block_74 = CodeBlock { "BoxClass_nonfixedclustered"; }
code_block_75 = CodeBlock { "BoxClass_nonfixedclustered"; }
valueAtKey_31 = DesignScript.Builtin.Dictionary.ValueAtKey(dictionary=code_block_72, key=code_block_75)
code_block_76 = CodeBlock { "BoxWidth"; }
valueAtKey_32 = DesignScript.Builtin.Dictionary.ValueAtKey(dictionary=valueAtKey_31, key=code_block_76)
code_block_77 = CodeBlock { "BoxLength"; }
valueAtKey_33 = DesignScript.Builtin.Dictionary.ValueAtKey(dictionary=valueAtKey_31, key=code_block_77)
byWidthLength = Rectangle.ByWidthLength(width=valueAtKey_32, length=valueAtKey_33)
center = Polygon.Center(polygon=byWidthLength)
ZAxis_2 = Vector.ZAxis()
code_block_78 = CodeBlock { [0,90,180,270]; }
count_4 = List.Count(list=byWidthLength@L2)
code_block_79 = CodeBlock { 0; 3; }
count_5 = List.Count(list=count_4@L2)
code_block_80 = CodeBlock { 0; 999; }
code_block_81 = CodeBlock { "RotatingSeed"; }
valueAtKey_34 = DesignScript.Builtin.Dictionary.ValueAtKey(dictionary=code_block_72, key=code_block_81)
randomList_2 = Math.RandomList(amount=count_5, value1=code_block_80.out0, value2=code_block_80.out1, seed=valueAtKey_34)
randomList_3 = Math.RandomList(amount=count_4@L2, value1=code_block_79.out0, value2=code_block_79.out1, seed=randomList_2@L2)
round = Math.Round(number=randomList_3)
getItemAtIndex_15 = List.GetItemAtIndex(list=code_block_78, index=round)
flatten_4 = List.Flatten(list=getItemAtIndex_15@L2)
rotate_2 = Geometry.Rotate(geometry=byWidthLength, origin=center, axis=ZAxis_2, degrees=flatten_4)
code_block_82 = CodeBlock(RotatedRectangle=rotate_2)
# ---------- code_block_82.designscript (3 lines) ----------
{
"RotatedRectangle": _RotatedRectangle
};
# ----------------------------------------
extendsChildDictionaryFromParent_6 = Custom[ExtendsChildDictionaryFromParent](ParentDic=valueAtKey_31, ChildDic=code_block_82)
setValueAtKeys_2 = DesignScript.Builtin.Dictionary.SetValueAtKeys(dictionary=code_block_72, keys=code_block_74, values=extendsChildDictionaryFromParent_6.dictionary)

# group: Bldg 장변 방향 종속 Space 처리
code_block_83 = CodeBlock(InputDic=setValueAtKeys_2) { _InputDic; }
code_block_84 = CodeBlock { "BoxClass_nonfixedclustered"; }
removeKeys = DesignScript.Builtin.Dictionary.RemoveKeys(dictionary=code_block_83, keys=code_block_84)
code_block_85 = CodeBlock { "BoxClass_nonfixedclustered"; }
valueAtKey_35 = DesignScript.Builtin.Dictionary.ValueAtKey(dictionary=code_block_83, key=code_block_85)
code_block_86 = CodeBlock { "RotatedRectangle"; }
removeKeys_2 = DesignScript.Builtin.Dictionary.RemoveKeys(dictionary=valueAtKey_35, keys=code_block_86)
code_block_87 = CodeBlock { "BoxRotate"; }
valueAtKey_36 = DesignScript.Builtin.Dictionary.ValueAtKey(dictionary=valueAtKey_35, key=code_block_87)
code_block_88 = CodeBlock(i=valueAtKey_36) { i==1?true:false; }
code_block_89 = CodeBlock { "RotatedRectangle"; }
valueAtKey_37 = DesignScript.Builtin.Dictionary.ValueAtKey(dictionary=valueAtKey_35, key=code_block_89)
rotatedRectangle = CodeBlock(RotatedRectangle=valueAtKey_37) { RotatedRectangle; }
center_2 = Polygon.Center(polygon=rotatedRectangle)
ZAxis_3 = Vector.ZAxis()
code_block_90 = CodeBlock { "BldgBoundary"; }
valueAtKey_38 = DesignScript.Builtin.Dictionary.ValueAtKey(dictionary=code_block_83, key=code_block_90)
explode = Geometry.Explode(geometry=valueAtKey_38)
flatten_5 = List.Flatten(list=explode)
direction = Line.Direction(line=flatten_5)
length_2 = Vector.Length(vector=direction)
maximumItem = List.MaximumItem(list=length_2)
indexOf = List.IndexOf(list=length_2, element=maximumItem)
getItemAtIndex_16 = List.GetItemAtIndex(list=direction, index=indexOf)
normalized = Vector.Normalized(vector=getItemAtIndex_16)
X_5 = Vector.X(vector=normalized)
round_2 = Math.Round(number=X_5)
Y_5 = Vector.Y(vector=normalized)
round_3 = Math.Round(number=Y_5)
code_block_91 = CodeBlock(i=round_2, j=round_3) { i<0 || j<0?true:false; }
reverse = Vector.Reverse(vector=normalized)
if_2 = If(test=code_block_91, true=reverse, false=normalized)
explode_2 = Geometry.Explode(geometry=valueAtKey_37)
flatten_6 = List.Flatten(list=explode_2@L2)
direction_2 = Line.Direction(line=flatten_6)
length_3 = Vector.Length(vector=direction_2)
maximumItem_2 = List.MaximumItem(list=length_3)
indexOf_2 = List.IndexOf(list=length_3@L2, element=maximumItem_2@L1)
getItemAtIndex_17 = List.GetItemAtIndex(list=direction_2@L2, index=indexOf_2@L1)
normalized_2 = Vector.Normalized(vector=getItemAtIndex_17)
X_6 = Vector.X(vector=normalized_2)
round_4 = Math.Round(number=X_6)
Y_6 = Vector.Y(vector=normalized_2)
round_5 = Math.Round(number=Y_6)
code_block_92 = CodeBlock(i=round_4, j=round_5) { i<0 || j<0?true:false; }
reverse_2 = Vector.Reverse(vector=normalized_2)
if_3 = If(test=code_block_92, true=reverse_2, false=normalized_2)
angleWithVector = Vector.AngleWithVector(vector=if_2, otherVector=if_3)
round_6 = Math.Round(number=angleWithVector)
rotate_3 = Geometry.Rotate(geometry=rotatedRectangle, origin=center_2, axis=ZAxis_3, degrees=round_6)
if_4 = If(test=code_block_88, true=rotate_3, false=rotatedRectangle)
code_block_93 = CodeBlock(RotatedRectangle=if_4)  # same code as code_block_82
extendsChildDictionaryFromParent_7 = Custom[ExtendsChildDictionaryFromParent](ParentDic=removeKeys_2, ChildDic=code_block_93)
code_block_94 = CodeBlock(BoxClass_nonfixedclu=extendsChildDictionaryFromParent_7.dictionary)  # same code as code_block_71
extendsChildDictionaryFromParent_8 = Custom[ExtendsChildDictionaryFromParent](ParentDic=removeKeys, ChildDic=code_block_94)

# group: 클러스터링 사각형들 Zvalue 맞춰 층별배치하기
code_block_95 = CodeBlock(InputDic=extendsChildDictionaryFromParent_8.dictionary) { _InputDic; }
code_block_96 = CodeBlock { "BoxClass_nonfixedclustered"; }
removeKeys_3 = DesignScript.Builtin.Dictionary.RemoveKeys(dictionary=code_block_95, keys=code_block_96)
code_block_97 = CodeBlock { "BoxClass_nonfixedclustered"; }
valueAtKey_39 = DesignScript.Builtin.Dictionary.ValueAtKey(dictionary=code_block_95, key=code_block_97)
code_block_98 = CodeBlock { "RotatedRectangle"; }
removeKeys_4 = DesignScript.Builtin.Dictionary.RemoveKeys(dictionary=valueAtKey_39, keys=code_block_98)
code_block_99 = CodeBlock { "RotatedRectangle"; }
valueAtKey_40 = DesignScript.Builtin.Dictionary.ValueAtKey(dictionary=valueAtKey_39, key=code_block_99)
code_block_100 = CodeBlock { "BoxZvalue"; }
valueAtKey_41 = DesignScript.Builtin.Dictionary.ValueAtKey(dictionary=valueAtKey_39, key=code_block_100)
translate = Geometry.Translate(geometry=valueAtKey_40, zTranslation=valueAtKey_41)
code_block_101 = CodeBlock(RotatedRectangle=translate)  # same code as code_block_82
extendsChildDictionaryFromParent_9 = Custom[ExtendsChildDictionaryFromParent](ParentDic=removeKeys_4, ChildDic=code_block_101)
code_block_102 = CodeBlock(BoxClass_nonfixedclu=extendsChildDictionaryFromParent_9.dictionary)  # same code as code_block_71
extendsChildDictionaryFromParent_10 = Custom[ExtendsChildDictionaryFromParent](ParentDic=removeKeys_3, ChildDic=code_block_102)

# group: 사각형 Surfaces 흔들어 배치
code_block_103 = CodeBlock(InputDic=extendsChildDictionaryFromParent_10.dictionary) { _InputDic; }
code_block_104 = CodeBlock { "BoxClass_nonfixedclustered"; }
removeKeys_5 = DesignScript.Builtin.Dictionary.RemoveKeys(dictionary=code_block_103, keys=code_block_104)
code_block_105 = CodeBlock { "BoxClass_nonfixedclustered"; }
valueAtKey_42 = DesignScript.Builtin.Dictionary.ValueAtKey(dictionary=code_block_103, key=code_block_105)
code_block_106 = CodeBlock { "RotatedRectangle"; }
valueAtKey_43 = DesignScript.Builtin.Dictionary.ValueAtKey(dictionary=valueAtKey_42, key=code_block_106)
byPatch = Surface.ByPatch(closedCurve=valueAtKey_43)
shakeRoomSurfaces = Custom[ShakeRoomSurfaces](i=byPatch)  # ShakeRoomSurfaces
code_block_107 = CodeBlock(ShakedSurfaces=shakeRoomSurfaces)
# ---------- code_block_107.designscript (3 lines) ----------
{
"ShakedSurfaces": _ShakedSurfaces
};
# ----------------------------------------
extendsChildDictionaryFromParent_11 = Custom[ExtendsChildDictionaryFromParent](ParentDic=valueAtKey_42, ChildDic=code_block_107)
code_block_108 = CodeBlock(BoxClass_nonfixedclu=extendsChildDictionaryFromParent_11.dictionary)  # same code as code_block_71
extendsChildDictionaryFromParent_12 = Custom[ExtendsChildDictionaryFromParent](ParentDic=removeKeys_5, ChildDic=code_block_108)

code_block_109 = CodeBlock(InputDic=extendsChildDictionaryFromParent_12.dictionary) { _InputDic; }
code_block_110 = CodeBlock { "BoxClass_nonfixedclustered"; }
valueAtKey_44 = DesignScript.Builtin.Dictionary.ValueAtKey(dictionary=code_block_109, key=code_block_110)
code_block_111 = CodeBlock { "ShakedSurfaces"; }
valueAtKey_45 = DesignScript.Builtin.Dictionary.ValueAtKey(dictionary=valueAtKey_44, key=code_block_111)
byJoinedSurfaces = PolySurface.ByJoinedSurfaces(surfaces=valueAtKey_45)
code_block_112 = CodeBlock { "BoxLevel"; }
valueAtKey_46 = DesignScript.Builtin.Dictionary.ValueAtKey(dictionary=valueAtKey_44, key=code_block_112)
firstItem_3 = List.FirstItem(list=valueAtKey_46@L2)
uniqueItems_4 = List.UniqueItems(list=firstItem_3)
allIndicesOf_2 = List.AllIndicesOf(list=firstItem_3, item=uniqueItems_4)
count_6 = List.Count(list=allIndicesOf_2@L2)
chop = List.Chop(list=byJoinedSurfaces, lengths=count_6)
code_block_113 = CodeBlock { "BldgBoundary"; }
valueAtKey_47 = DesignScript.Builtin.Dictionary.ValueAtKey(dictionary=code_block_109, key=code_block_113)
explode_3 = Geometry.Explode(geometry=valueAtKey_47)
length_4 = Curve.Length(curve=explode_3)
flatten_7 = List.Flatten(list=length_4)
minimumItem = List.MinimumItem(list=flatten_7)
maximumItem_3 = List.MaximumItem(list=flatten_7)
watch_5 = Watch(shakeRoomSurfaces)
flatten_8 = List.Flatten(list=watch_5)
perimeterCurves = Surface.PerimeterCurves(surface=flatten_8)
byJoinedCurves_2 = PolyCurve.ByJoinedCurves(curves=perimeterCurves)
watch_6 = Watch(valueAtKey_47)
explode_4 = Geometry.Explode(geometry=watch_6)
code_block_114 = CodeBlock { 2; }
dropItems_2 = List.DropItems(list=explode_4@L2, amount=code_block_114)
length_5 = Curve.Length(curve=dropItems_2)
firstItem_4 = List.FirstItem(list=length_5@L2)
lastItem = List.LastItem(list=length_5@L2)
byWidthLength_2 = Rectangle.ByWidthLength(width=firstItem_4, length=lastItem)
code_block_115 = CodeBlock { 2; }
dropItems_3 = List.DropItems(list=perimeterCurves@L2, amount=code_block_115)
length_6 = Curve.Length(curve=dropItems_3)
lastItem_2 = List.LastItem(list=length_6@L2)
firstItem_5 = List.FirstItem(list=length_6@L2)
byWidthLength_3 = Rectangle.ByWidthLength(width=lastItem_2, length=firstItem_5)
flatten_9 = List.Flatten(list=byWidthLength_3)
count_7 = List.Count(list=watch_5@L2)
chop_2 = List.Chop(list=flatten_9, lengths=count_7)
code_block_116 = CodeBlock(a=chop_2) { a[6]; }
byPatch_2 = Surface.ByPatch(closedCurve=watch_6)
code_block_117 = CodeBlock { 0.5; }
pointAtParameter = Surface.PointAtParameter(surface=byPatch_2, u=code_block_117, v=code_block_117)
X_7 = Point.X(point=pointAtParameter)
Y_7 = Point.Y(point=pointAtParameter)
Z = Point.Z(point=pointAtParameter)
byOrigin = CoordinateSystem.ByOrigin(x=X_7, y=Y_7, z=Z)
byWidthLength_4 = Rectangle.ByWidthLength(cs=byOrigin, width=firstItem_4, length=lastItem)

# group: Packing strategy
# note: Refinery Space Planning Toolkit
rectangleAreaStrategy = Autodesk.RefineryToolkits.SpacePlanning.Generate.Packing.RectangleAreaStrategy()

packRectangles = Autodesk.RefineryToolkits.SpacePlanning.Generate.Packing.PackRectangles(items=code_block_116, containers=byWidthLength_4, strategy=rectangleAreaStrategy)
watch_7 = Watch(packRectangles.Packed_Items)
watch_8 = Watch(packRectangles.Remaining_Items)
byPatch_3 = Surface.ByPatch(closedCurve=code_block_116)
shakeRoomSurfaces_2 = Custom[ShakeRoomSurfaces](i=byPatch_3)
python_script_2 = Python(IN[0]=byPatch_3, IN[1]=byOrigin, IN[2]=firstItem_4, IN[3]=lastItem)  # IronPython2
# ---------- python_script_2.python (370 lines) ----------
# Python 표준 및 DesignScript 라이브러리 로드
from random import randint
import sys
import clr
clr.AddReference('ProtoGeometry')
clr.AddReference('DSCoreNodes')
from DSCore import *
from Autodesk.DesignScript.Geometry import *



def GetXOrderSurfaces(sl):
    ls = []
    for s in sl:
        ls.append(SortByMinX(s))

    ls.sort()

    r = []
    for l in ls:
        r.append(l.val)

    return r

def GetYOrderSurfaces(sl):
    ls = []
    for s in sl:
        ls.append(SortByMinY(s))

    ls.sort()

    r = []
    for l in ls:
        r.append(l.val)

    return r

def GetIndexOfSurface(s, sl):
    for i in range(0, len(sl)):
        if sl[i] == s:
            return i

def GetSurfaceMinX(s):
    a1 = Math.Min(s.PointAtParameter(0,0).X, s.PointAtParameter(0,1).X)
    a2 = Math.Min(s.PointAtParameter(1,0).X, s.PointAtParameter(1,1).X)
    return Math.Min(a1, a2)

def GetSurfaceMaxX(s):
    a1 = Math.Max(s.PointAtParameter(0,0).X, s.PointAtParameter(0,1).X)
    a2 = Math.Max(s.PointAtParameter(1,0).X, s.PointAtParameter(1,1).X)
    return Math.Max(a1, a2)

def GetSurfaceMinY(s):
    a1 = Math.Min(s.PointAtParameter(0,0).Y, s.PointAtParameter(0,1).Y)
    a2 = Math.Min(s.PointAtParameter(1,0).Y, s.PointAtParameter(1,1).Y)
    return Math.Min(a1, a2)

def GetSurfaceMaxY(s):
    a1 = Math.Max(s.PointAtParameter(0,0).Y, s.PointAtParameter(0,1).Y)
    a2 = Math.Max(s.PointAtParameter(1,0).Y, s.PointAtParameter(1,1).Y)
    return Math.Max(a1, a2)


class SortByMinX(object):
     def __init__(self, val):
         self.val = val

     def __lt__(self, other):
         return GetSurfaceMinX(self.val) < GetSurfaceMinX(other.val)

class SortByMinY(object):
     def __init__(self, val):
         self.val = val

     def __lt__(self, other):
         return GetSurfaceMinY(self.val) < GetSurfaceMinY(other.val)


def CreateXCheckerSurface(s):
    minX = GetSurfaceMinX(s)
    minY = GetSurfaceMinY(s)
    maxX = GetSurfaceMaxX(s)
    maxY = GetSurfaceMaxY(s)
    minZ = s.PointAtParameter(0,0).Z
    pl = [
            Point.ByCoordinates(minX - 100000, minY + 0.1, minZ),
            Point.ByCoordinates(minX - 100000, maxY - 0.1, minZ),
            Point.ByCoordinates(minX, maxY - 0.1, minZ),
            Point.ByCoordinates(minX, minY + 0.1, minZ),
        ]

    checkerX = Surface.ByPerimeterPoints(pl)

    return checkerX

def CreateYCheckerSurface(s):
    minX = GetSurfaceMinX(s)
    minY = GetSurfaceMinY(s)
    maxX = GetSurfaceMaxX(s)
    maxY = GetSurfaceMaxY(s)
    minZ = s.PointAtParameter(0,0).Z
    pl = [
            Point.ByCoordinates(minX + 0.1, minY - 100000, minZ),
            Point.ByCoordinates(minX + 0.1, minY, minZ),
            Point.ByCoordinates(maxX - 0.1, minY, minZ),
            Point.ByCoordinates(maxX - 0.1, minY - 100000, minZ),
        ]

    checkerX = Surface.ByPerimeterPoints(pl)

    return checkerX

def GetDistanceXToMove(s, sl):
    checkerX = CreateXCheckerSurface(s)

    cl = []

    noHit = True

    for si in sl:
        if si == s:
            continue
        else:
            if checkerX.DoesIntersect(si) == True:
                noHit = False

                cl.append(si.PointAtParameter(0,0).X)
                cl.append(si.PointAtParameter(0,1).X)
                cl.append(si.PointAtParameter(1,0).X)
                cl.append(si.PointAtParameter(1,1).X)

    if noHit == True:
        return - GetSurfaceMinX(s)
    else:
        cl.sort(reverse=True)
        return cl[0] - GetSurfaceMinX(s)

def GetDistanceYToMove(s, sl):
    checkerY = CreateYCheckerSurface(s)

    cl = []

    noHit = True

    for si in sl:
        if si == s:
            continue
        else:
            if checkerY.DoesIntersect(si) == True:
                noHit = False

                cl.append(si.PointAtParameter(0,0).Y)
                cl.append(si.PointAtParameter(0,1).Y)
                cl.append(si.PointAtParameter(1,0).Y)
                cl.append(si.PointAtParameter(1,1).Y)

    if noHit == True:
        return - GetSurfaceMinY(s)
    else:
        cl.sort(reverse=True)
        return cl[0] - GetSurfaceMinY(s)


def MoveX():
    xOrdered = GetXOrderSurfaces(surfacelist)

    for s in xOrdered:    
        toMoveX = GetDistanceXToMove(s, surfacelist)
        idx = GetIndexOfSurface(s, surfacelist)
        surfacelist[idx] = Geometry.Translate(surfacelist[idx], toMoveX, 0, 0)

def MoveY():
    yOrdered = GetYOrderSurfaces(surfacelist)

    for s in yOrdered:
        toMoveY = GetDistanceYToMove(s, surfacelist)
        idx = GetIndexOfSurface(s, surfacelist)
        surfacelist[idx] = Geometry.Translate(surfacelist[idx], 0, toMoveY, 0)

def SplitX():
    xOrdered = GetXOrderSurfaces(surfacelist)

    offsetX = 0   
    for i in range(0, len(xOrdered)):
        idx = GetIndexOfSurface(xOrdered[i], surfacelist)

        mx = offsetX - GetSurfaceMinX(surfacelist[idx])
        surfacelist[idx] = Geometry.Translate(surfacelist[idx], mx, 0, 0)

        sx = GetSurfaceMaxX(surfacelist[idx]) - GetSurfaceMinX(surfacelist[idx])
        offsetX = offsetX + sx

def SplitY():
    yOrdered = GetYOrderSurfaces(surfacelist)

    offsetY = 0   
    for i in range(0, len(yOrdered)):
        idx = GetIndexOfSurface(yOrdered[i], surfacelist)

        my = offsetY - GetSurfaceMinY(surfacelist[idx])
        surfacelist[idx] = Geometry.Translate(surfacelist[idx], 0, my, 0)

        sy = GetSurfaceMaxY(surfacelist[idx]) - GetSurfaceMinY(surfacelist[idx])
        offsetY = offsetY + sy

def MinofAll():
    allX = []
    allY = []
    for s in surfacelist:
        allX.append(GetSurfaceMinX(s))
        allY.append(GetSurfaceMinY(s))
    allX.sort()
    allY.sort()
    x = 0
    if allX[0] < 0:
        x = -allX[0]
    y = 0
    if allY[0] < 0:
        y = -allY[0]

    return x,y

def MaxofAll():
    allX = []
    allY = []
    for s in surfacelist:
        allX.append(GetSurfaceMaxX(s))
        allY.append(GetSurfaceMaxY(s))
    allX.sort(reverse=True)
    allY.sort(reverse=True)

    return (allX[0], allY[0])

def GetRectMinMaxCornerPoint(center, width, length):
    return (Point.ByCoordinates(center.X - width / 2, center.Y - length /2, center.Z), Point.ByCoordinates(center.X + width / 2, center.Y + length /2, center.Z))


def RepositionInRectOutX(center, width, length):
    (minPos, maxPos) = GetRectMinMaxCornerPoint(center, width, length)
    rectX = maxPos.X - minPos.X
    rectY = maxPos.Y - minPos.Y

    for i in range(0, len(surfacelist)):
        if GetSurfaceMaxX(surfacelist[i]) > rectX:
            (allMaxX, allMaxY) = MaxofAll()
            offsetY = allMaxY - GetSurfaceMinY(surfacelist[i])
            surfacelist[i] = Geometry.Translate(surfacelist[i], 0, offsetY, 0)
            MoveX()
            MoveY()

def RepositionInRectInX(center, width, length):
    (minPos, maxPos) = GetRectMinMaxCornerPoint(center, width, length)
    rectX = maxPos.X - minPos.X
    rectY = maxPos.Y - minPos.Y

    for i in range(0, len(surfacelist)):
        if GetSurfaceMaxX(surfacelist[i]) > rectX:
            offsetY = rectY - GetSurfaceMaxY(surfacelist[i])
            surfacelist[i] = Geometry.Translate(surfacelist[i], 0, offsetY, 0)
            MoveX()
            MoveY()

def RepositionInRectOutY(center, width, length):
    (minPos, maxPos) = GetRectMinMaxCornerPoint(center, width, length)
    rectX = maxPos.X - minPos.X
    rectY = maxPos.Y - minPos.Y

    for i in range(0, len(surfacelist)):
        if GetSurfaceMaxY(surfacelist[i]) > rectY:
            (allMaxX, allMaxY) = MaxofAll()
            offsetX = allMaxX - GetSurfaceMinX(surfacelist[i])
            surfacelist[i] = Geometry.Translate(surfacelist[i], offsetX, 0, 0)
            MoveY()
            MoveX()

def RepositionInRectInY(center, width, length):
    (minPos, maxPos) = GetRectMinMaxCornerPoint(center, width, length)
    rectX = maxPos.X - minPos.X
    rectY = maxPos.Y - minPos.Y

    for i in range(0, len(surfacelist)):
        if GetSurfaceMaxY(surfacelist[i]) > rectY:
            offsetX = rectX - GetSurfaceMaxX(surfacelist[i])
            surfacelist[i] = Geometry.Translate(surfacelist[i], offsetX, 0, 0)
            MoveY()
            MoveX()

def MoveAllTo(ox, oy):
    for i in range(0, len(surfacelist)):
        surfacelist[i] = Geometry.Translate(surfacelist[i], ox, oy, 0)

def CheckOutOfBoundary(center, width, length):
    result = []
    (minPos, maxPos) = GetRectMinMaxCornerPoint(center, width, length)
    rectX = maxPos.X - minPos.X
    rectY = maxPos.Y - minPos.Y

    for i in range(0, len(surfacelist)):
        if GetSurfaceMaxX(surfacelist[i]) > rectX or GetSurfaceMaxY(surfacelist[i]) > rectY:
            result.append(i)
    return result



#def FindBoundaryPoint(crv):
#    x = crv.PointAtParameter(0).X
#    y = crv.PointAtParameter(0).Y
#    
#    return x,y


# 이 노드에 대한 입력값은 IN 변수에 리스트로 저장됩니다.
dataEnteringNode = IN

# 코드를 이 선 아래에 배치

surfaces = IN[0]
cs = IN[1]
width = IN[2]
length = IN[3]
#bdCrv = IN[1]

(boundryMin, boundryMax) = GetRectMinMaxCornerPoint(cs[0].Origin, width[0], length[0])

surfacelist = []
for s in surfaces:
    surfacelist.append(s)

(basX, basY) = MinofAll()
#(basX, basY) = FindBoundaryPoint(bdCrv)
#(basX, basY) = 0, 0

for i in range(0, len(surfacelist)):
    surfacelist[i] = Geometry.Translate(surfacelist[i], basX, basY, 0)

if randint(0, 1) == 0:
    SplitX()
    MoveX()
    MoveY()
    MoveX()
    MoveY()

else:
    SplitY()
    MoveY()
    MoveX()
    MoveY()
    MoveX()

RepositionInRectOutX(cs[0].Origin, width[0], length[0])
RepositionInRectOutY(cs[0].Origin, width[0], length[0])
RepositionInRectInX(cs[0].Origin, width[0], length[0])
RepositionInRectInY(cs[0].Origin, width[0], length[0])

failed = CheckOutOfBoundary(cs[0].Origin, width[0], length[0])

MoveAllTo(boundryMin.X, boundryMin.Y)

# testnum = IN[1]
# xOrdered = GetXOrderSurfaces(surfacelist)

# # for s in xOrdered:    
# toMoveX = GetDistanceXToMove(xOrdered[testnum], surfacelist)
# idx = GetIndexOfSurface(xOrdered[testnum], surfacelist)
# surfacelist[idx] = Geometry.Translate(surfacelist[idx], toMoveX, 0, 0)



# 출력을 OUT 변수에 지정합니다.
OUT = (surfacelist, failed)
# ----------------------------------------
