# Dynamo graph 1012 space planning GD MASS test mk.dyn (Dynamo 2.10.1.3976)
# packages: GenerativeDesign.Revit 1.7.3.0, GenerativeDesign 1.7.3.0, GenerativeDesign 1.8.7.0

# group: User Inputs for GDIR
# note: Custom Package: GenerativeDesign v.2021.5.5
select_room_to_load_program_into = DSModelRoomSelection()  # 1 picked in the model; graph input
# note: Retrieve the room's finish boundary.
# Note: The first sublist is the outermost boundary of the room.
finishBoundary = Room.FinishBoundary(room=select_room_to_load_program_into)
remember = Data.Remember(finishBoundary)

# group: Extract room boundary for DynaSpace and cache it in the graph
firstItem = List.FirstItem(list=remember@L3)
startPoint = Curve.StartPoint(curve=firstItem)
flatten = List.Flatten(list=startPoint)
byJoinedCurves = PolyCurve.ByJoinedCurves(curves=firstItem)
code_block = CodeBlock(BldgBoundary=byJoinedCurves)
# ---------- code_block.designscript (3 lines) ----------
{
"BldgBoundary": _BldgBoundary
};
# ----------------------------------------

# group: 고정부 Seed
seed_고정부_코어 = DoubleSlider(200, range=0..999 step 100)  # graph input

# group: 변동부 Seed
seed_변형부_공간 = DoubleSlider(300, range=0..999 step 100)  # graph input

# group: 회전 Seed
seed_회전용 = DoubleSlider(800, range=0..999 step 100)  # graph input

# group: Floor Level
code_block_2 = CodeBlock { [-6000, 0, 6000, 12000]; }

code_block_3 = CodeBlock(FixedPartSeed=seed_고정부_코어, NonFixedPartSeed=seed_변형부_공간, RotatingSeed=seed_회전용, FloorLevel=code_block_2)
# ---------- code_block_3.designscript (6 lines) ----------
{
"FixedPartSeed": _FixedPartSeed,
"NonFixedPartSeed": _NonFixedPartSeed,
"RotatingSeed": _RotatingSeed,
"FloorLevel": _FloorLevel
};
# ----------------------------------------
extendsChildDictionaryFromParent = Custom[ExtendsChildDictionaryFromParent](ParentDic=code_block, ChildDic=code_block_3)  # Extends Child Dictionary From Parent

# group: Excel Data import (package 정리 전)
file_path = Filename(".\space planning test 1008mk 001.xlsx")
file_from_path = FileObject(path=file_path)
string_from_object = FromObject(object=file_from_path)
code_block_4 = CodeBlock { "Sheet1"; "SampleBuildingProgram-Clinic"; false; }
python_script_import_excel_by = Python(IN[0]=string_from_object, IN[1]=code_block_4.out0)  # "Python Script@Import Excel(By OpenpyXl)"; CPython3
# ---------- python_script_import_excel_by.python (50 lines) ----------
# Load the Python Standard and DesignScript Libraries
import sys
import os
#sys.path.append(r'C:\Users\HEC\AppData\Local\Programs\Python\Python39\Lib\site-packages')
#sys.path.append(r'C:\Users\pjmk0\AppData\Local\Programs\Python\Python39\Lib\site-packages')
sys.path.append(os.getenv('LOCALAPPDATA').replace('\\','\\\\') + r'\Programs\Python\Python39\Lib\site-packages')
import clr
clr.AddReference('ProtoGeometry')
from Autodesk.DesignScript.Geometry import *
from collections import Iterable

def iterable(obj):
    return isinstance(obj, Iterable)


# The inputs to this node will be stored as a list in the IN variables.
dataEnteringNode = IN
PathIn = IN[0]
SheetNameIn = IN[1]

# Place your code below this line
import datetime
import openpyxl

path = (PathIn)
#path = (r'C:\Users\pjmk0\Downloads\MK\mQ\BIM_물량집계 자동화 산출기준표_rC(20210607)_mk_de.xlsx')

wb_obj = openpyxl.load_workbook(path, data_only=True)
sheet_obj = wb_obj.get_sheet_by_name(SheetNameIn)

m_row = sheet_obj.max_row
m_col = sheet_obj.max_column

listOut = []



for i in range(1, m_row +1):
    listTemp = []
    for j in range(1, m_col + 1):
        cell_obj = sheet_obj.cell(row=i, column=j)
        listTemp.append(cell_obj.value)
        if len(listTemp) == m_col:
            listOut.append(listTemp)
        


# Assign your output to the OUT variable.
OUT = listOut
#OUT = os.getenv('APPDATA')
# ----------------------------------------
excel_data_정리_전 = Watch(python_script_import_excel_by)

remember_2 = Data.Remember(excel_data_정리_전)

# group: Excel List 분할 + BoxPrimary 생성
excel_list_분할_boxprimary_생성 = Python(IN[0]=remember_2)  # CPython3
# ---------- excel_list_분할_boxprimary_생성.python (52 lines) ----------
# Load the Python Standard and DesignScript Libraries
import sys
import clr
clr.AddReference('ProtoGeometry')
from Autodesk.DesignScript.Geometry import *

# The inputs to this node will be stored as a list in the IN variables.
dataEnteringNode = IN
input = IN[0]
# Place your code below this line

trpsdList = list(map(lambda x: x, zip(*input)))

result = []
for i in trpsdList:
    ii = list(i)
    del ii[0]
    result.append(ii)
    
BoxSpaceID = result[0]
BoxSpaceName = result[1]
BoxAdjacentSpaces = result[10]
BoxDepartmentID = result[3]
BoxDepartment = result[2]
BoxLevel = result[11]
BoxWidth = result[5]
BoxLength = result[6]
BoxHeight = result[7]
BoxArea = result[8]
BoxRotate = result[14]
BoxCluster = result[15]
BoxInteriorFinish = result[16]
BoxExteriorFinish = result[17]

OutDic = {
"BoxSpaceID": BoxSpaceID,
"BoxSpaceName": BoxSpaceName,
"BoxAdjacentSpaces": BoxAdjacentSpaces,
"BoxDepartmentID": BoxDepartmentID,
"BoxDepartment": BoxDepartment,
"BoxLevel": BoxLevel,
"BoxWidth": BoxWidth,
"BoxLength": BoxLength,
"BoxHeight": BoxHeight,
"BoxArea": BoxArea,
"BoxRotate": BoxRotate,
"BoxCluster": BoxCluster,
"BoxInteriorFinish": BoxInteriorFinish,
"BoxExteriorFinish": BoxExteriorFinish
}
# Assign your output to the OUT variable.
OUT = OutDic
# ----------------------------------------
code_block_5 = CodeBlock(BoxClass_Primary=excel_list_분할_boxprimary_생성)
# ---------- code_block_5.designscript (3 lines) ----------
{
"BoxClass_Primary": _BoxClass_Primary
};
# ----------------------------------------
extendsChildDictionaryFromParent_2 = Custom[ExtendsChildDictionaryFromParent](ParentDic=extendsChildDictionaryFromParent.dictionary, ChildDic=code_block_5)

watch = Watch(extendsChildDictionaryFromParent_2.key)

# group: Box 프로퍼티에 BoxZvalue추가(Level에 따라 Z 값 Dictionary 추출)
code_block_6 = CodeBlock(InputDic=extendsChildDictionaryFromParent_2.dictionary) { _InputDic; }
code_block_7 = CodeBlock { "BoxClass_Primary"; }
setBoxZvalueProp = Python(IN[0]=code_block_6)  # CPython3
# ---------- setBoxZvalueProp.python (37 lines) ----------
# Load the Python Standard and DesignScript Libraries
import sys
import clr
clr.AddReference('ProtoGeometry')
from Autodesk.DesignScript.Geometry import *

# The inputs to this node will be stored as a list in the IN variables.
dataEnteringNode = IN
inputDic = IN[0]
# Place your code below this line

BoxClass_Primary = inputDic["BoxClass_Primary"]
BoxLevel = BoxClass_Primary["BoxLevel"]
#######################################################################
BoxLevel_Uniq = []
for i in BoxLevel:
    if i in BoxLevel_Uniq:
        pass
    else:
        BoxLevel_Uniq.append(i)

FloorLevel = inputDic["FloorLevel"]

dic_Floor_Level = {}
for i in range(len(BoxLevel_Uniq)):
        dic_Floor_Level[BoxLevel_Uniq[i]] = FloorLevel[i]


BoxZvalue = list(map(lambda x: dic_Floor_Level[x], BoxLevel))

#######################################################################

BoxClass_Primary["BoxZvalue"] = BoxZvalue
result = BoxClass_Primary

# Assign your output to the OUT variable.
OUT = result
# ----------------------------------------
setValueAtKeys = DesignScript.Builtin.Dictionary.SetValueAtKeys(dictionary=code_block_6, keys=code_block_7, values=setBoxZvalueProp)

# group: 룸 BoundingBox 그리드 포인트 생성
code_block_8 = CodeBlock(InputDic=setValueAtKeys) { _InputDic; }
code_block_9 = CodeBlock { "BldgBoundary"; }
valueAtKey = DesignScript.Builtin.Dictionary.ValueAtKey(dictionary=code_block_8, key=code_block_9)
byGeometry = BoundingBox.ByGeometry(geom=valueAtKey)
minPoint = BoundingBox.MinPoint(boundingBox=byGeometry)
X = Point.X(point=minPoint)
maxPoint = BoundingBox.MaxPoint(boundingBox=byGeometry)
X_2 = Point.X(point=maxPoint)
code_block_10 = CodeBlock { 500; }
code_block_11 = CodeBlock(a=X, b=X_2, x=code_block_10) { a..b..x; }
Y = Point.Y(point=minPoint)
Y_2 = Point.Y(point=maxPoint)
code_block_12 = CodeBlock { 500; }
code_block_13 = CodeBlock(a=Y, b=Y_2, x=code_block_12) { a..b..x; }
byCoordinates = Point.ByCoordinates(x=code_block_11, y=code_block_13, lacing=CrossProduct)
flatten_2 = List.Flatten(list=byCoordinates)
code_block_14 = CodeBlock(GridPointOfBldgBoundary=flatten_2)
# ---------- code_block_14.designscript (3 lines) ----------
{
"GridPointOfBldgBoundary": _GridPointOfBldgBoundary
};
# ----------------------------------------
extendsChildDictionaryFromParent_3 = Custom[ExtendsChildDictionaryFromParent](ParentDic=code_block_8, ChildDic=code_block_14)

# group: DistributeRandomSeedForFixedPart
code_block_15 = CodeBlock(InputDic=extendsChildDictionaryFromParent_3.dictionary) { _InputDic; }
distributeRandomSeedForFixedPart = Custom[DistributeRandomSeedForFixedPart](InputDic=code_block_15)  # DistributeRandomSeedForFixedPart

# group: Fixed Part 형상 배치 by Seed(회전 고려)
code_block_16 = CodeBlock(InputDic=distributeRandomSeedForFixedPart) { _InputDic; }
code_block_17 = CodeBlock { "BoxClass_fixedpart"; }
valueAtKey_2 = DesignScript.Builtin.Dictionary.ValueAtKey(dictionary=code_block_16, key=code_block_17)
code_block_18 = CodeBlock { "BoxZvalue"; }
valueAtKey_3 = DesignScript.Builtin.Dictionary.ValueAtKey(dictionary=valueAtKey_2, key=code_block_18)
uniqueItems = List.UniqueItems(list=valueAtKey_3)
code_block_19 = CodeBlock { "BoxClass_fixedpart"; }
code_block_20 = CodeBlock { "BoxGeometry"; }
components = DesignScript.Builtin.Dictionary.Components(dictionary=valueAtKey_2)
addItemToEnd = List.AddItemToEnd(item=code_block_20, list=components.keys)
code_block_21 = CodeBlock { "GridPointOfBldgBoundary"; }
valueAtKey_4 = DesignScript.Builtin.Dictionary.ValueAtKey(dictionary=code_block_16, key=code_block_21)
code_block_22 = CodeBlock { "BoxSeed"; }
valueAtKey_5 = DesignScript.Builtin.Dictionary.ValueAtKey(dictionary=valueAtKey_2, key=code_block_22)
getItemAtIndex = List.GetItemAtIndex(list=valueAtKey_4, index=valueAtKey_5)
X_3 = Point.X(point=getItemAtIndex)
Y_3 = Point.Y(point=getItemAtIndex)
firstItem_2 = List.FirstItem(list=valueAtKey_3)
code_block_23 = CodeBlock(i=valueAtKey_3, j=firstItem_2) { i+Math.Abs(j/2); }
byCoordinates_2 = Point.ByCoordinates(x=X_3, y=Y_3, z=code_block_23)
code_block_24 = CodeBlock { "BoxWidth"; }
valueAtKey_6 = DesignScript.Builtin.Dictionary.ValueAtKey(dictionary=valueAtKey_2, key=code_block_24)
code_block_25 = CodeBlock { "BoxLength"; }
valueAtKey_7 = DesignScript.Builtin.Dictionary.ValueAtKey(dictionary=valueAtKey_2, key=code_block_25)
code_block_26 = CodeBlock { "BoxHeight"; }
valueAtKey_8 = DesignScript.Builtin.Dictionary.ValueAtKey(dictionary=valueAtKey_2, key=code_block_26)
byLengths = Cuboid.ByLengths(origin=byCoordinates_2, width=valueAtKey_6, length=valueAtKey_7, height=valueAtKey_8)
centroid = Solid.Centroid(solid=byLengths)
ZAxis = Vector.ZAxis()
code_block_27 = CodeBlock { "BoxClass_Primary"; }
valueAtKey_9 = DesignScript.Builtin.Dictionary.ValueAtKey(dictionary=code_block_16, key=code_block_27)
code_block_28 = CodeBlock { "BoxDepartment"; }
valueAtKey_10 = DesignScript.Builtin.Dictionary.ValueAtKey(dictionary=valueAtKey_9, key=code_block_28)
code_block_29 = CodeBlock()
# ---------- code_block_29.designscript (6 lines) ----------
[
"PATHV1",
"PATHV2",
"PATHV3"
];
[];
# ----------------------------------------
contains = String.Contains(str=valueAtKey_10, searchFor=code_block_29.out0@@L1)
boolean = BoolSelector(true)
allIndicesOf = List.AllIndicesOf(list=contains@@L2, item=boolean)
count = List.Count(list=allIndicesOf)
code_block_30 = CodeBlock { 0; }
code_block_31 = CodeBlock { 90; }
code_block_32 = CodeBlock { "RotatingSeed"; }
valueAtKey_11 = DesignScript.Builtin.Dictionary.ValueAtKey(dictionary=code_block_16, key=code_block_32)
randomList = Math.RandomList(amount=count, value1=code_block_30, value2=code_block_31, seed=valueAtKey_11)
code_block_33 = CodeBlock(i=randomList) { i>=45; }
code_block_34 = CodeBlock { 90; 0; }
if_ = If(test=code_block_33, true=code_block_34.out0, false=code_block_34.out1)
count_2 = List.Count(list=allIndicesOf@L2)
ofRepeatedItem = List.OfRepeatedItem(item=if_@L1, amount=count_2@L1)
flatten_3 = List.Flatten(list=ofRepeatedItem)
# note: 고정부 매스
rotate = Geometry.Rotate(geometry=byLengths, origin=centroid, axis=ZAxis, degrees=flatten_3)
addItemToEnd_2 = List.AddItemToEnd(item=rotate, list=components.values)
byKeysValues = DesignScript.Builtin.Dictionary.ByKeysValues(keys=addItemToEnd, values=addItemToEnd_2)
setValueAtKeys_2 = DesignScript.Builtin.Dictionary.SetValueAtKeys(dictionary=code_block_16, keys=code_block_19, values=byKeysValues)

# group: 레벨 별 고정부 비점유 포인트 추출
code_block_35 = CodeBlock(InputDic=setValueAtKeys_2) { _InputDic; }
code_block_36 = CodeBlock { "GridPointOfBldgBoundary"; }
valueAtKey_12 = DesignScript.Builtin.Dictionary.ValueAtKey(dictionary=code_block_35, key=code_block_36)
X_4 = Point.X(point=valueAtKey_12)
Y_4 = Point.Y(point=valueAtKey_12)
code_block_37 = CodeBlock { "BoxClass_fixedpart"; }
valueAtKey_13 = DesignScript.Builtin.Dictionary.ValueAtKey(dictionary=code_block_35, key=code_block_37)
code_block_38 = CodeBlock { "BoxZvalue"; }
valueAtKey_14 = DesignScript.Builtin.Dictionary.ValueAtKey(dictionary=valueAtKey_13, key=code_block_38)
uniqueItems_2 = List.UniqueItems(list=valueAtKey_14)
byCoordinates_3 = Point.ByCoordinates(x=X_4, y=Y_4, z=uniqueItems_2@L1)
code_block_39 = CodeBlock { "BoxGeometry"; }
valueAtKey_15 = DesignScript.Builtin.Dictionary.ValueAtKey(dictionary=valueAtKey_13, key=code_block_39)
byUnion = Solid.ByUnion(solids=valueAtKey_15)
doesIntersect = Geometry.DoesIntersect(geometry=byCoordinates_3, other=byUnion)
filterByBoolMask = List.FilterByBoolMask(list=byCoordinates_3@L2, mask=doesIntersect@L2)
watch_2 = Watch(filterByBoolMask.out)
code_block_40 = CodeBlock(RestGridPointByLevel=watch_2)
# ---------- code_block_40.designscript (3 lines) ----------
{
"RestGridPointByLevel": _RestGridPointByLevel
};
# ----------------------------------------
extendsChildDictionaryFromParent_4 = Custom[ExtendsChildDictionaryFromParent](ParentDic=code_block_35, ChildDic=code_block_40)

code_block_41 = CodeBlock(i=filterByBoolMask.out) { i; }

# group: FindNonFixedPartBox
code_block_42 = CodeBlock(InputDic=extendsChildDictionaryFromParent_4.dictionary) { _InputDic; }
findNonFixedPartBox = Custom[FindNonFixedPartBox](InputDic=code_block_42)  # FindNonFixedPartBox

# group: DistributeRandomSeedForNonFixedPart
code_block_43 = CodeBlock(InputDic=findNonFixedPartBox) { _InputDic; }
distributeRandomSeedForNonFixedPart = Custom[DistributeRandomSeedForNonFixedPart](InputDic=code_block_43)  # DistributeRandomSeedForNonFixedPart

# group: 비 고정부 클러스터링 딕셔너리 형성
code_block_44 = CodeBlock(InputDic=distributeRandomSeedForNonFixedPart) { _InputDic; }
code_block_45 = CodeBlock { "BoxClass_nonfixedpart"; }
valueAtKey_16 = DesignScript.Builtin.Dictionary.ValueAtKey(dictionary=code_block_44, key=code_block_45)
code_block_46 = CodeBlock { "BoxCluster"; }
valueAtKey_17 = DesignScript.Builtin.Dictionary.ValueAtKey(dictionary=valueAtKey_16, key=code_block_46)
uniqueItems_3 = List.UniqueItems(list=valueAtKey_17)
list_allindicesof = List.AllIndicesOf(list=valueAtKey_17, item=uniqueItems_3)
count_3 = List.Count(list=list_allindicesof@L2)
components_2 = DesignScript.Builtin.Dictionary.Components(dictionary=valueAtKey_16)
getItemAtIndex_2 = List.GetItemAtIndex(list=components_2.values@L2, index=list_allindicesof)
byKeysValues_2 = DesignScript.Builtin.Dictionary.ByKeysValues(keys=components_2.keys, values=getItemAtIndex_2)
code_block_47 = CodeBlock(BoxClass_nonfixedclu=byKeysValues_2)
# ---------- code_block_47.designscript (3 lines) ----------
{
"BoxClass_nonfixedclustered": _BoxClass_nonfixedclustered
};
# ----------------------------------------
extendsChildDictionaryFromParent_5 = Custom[ExtendsChildDictionaryFromParent](ParentDic=code_block_44, ChildDic=code_block_47)

# group: 클러스터별 지오메트리 형성(랜덤회전 반영)
code_block_48 = CodeBlock(InputDic=extendsChildDictionaryFromParent_5.dictionary) { _InputDic; }
code_block_49 = CodeBlock { "BldgBoundary"; }
valueAtKey_18 = DesignScript.Builtin.Dictionary.ValueAtKey(dictionary=code_block_48, key=code_block_49)
code_block_50 = CodeBlock { "BoxClass_nonfixedclustered"; }
code_block_51 = CodeBlock { "BoxClass_nonfixedclustered"; }
valueAtKey_19 = DesignScript.Builtin.Dictionary.ValueAtKey(dictionary=code_block_48, key=code_block_51)
code_block_52 = CodeBlock { "BoxWidth"; }
valueAtKey_20 = DesignScript.Builtin.Dictionary.ValueAtKey(dictionary=valueAtKey_19, key=code_block_52)
code_block_53 = CodeBlock { "BoxLength"; }
valueAtKey_21 = DesignScript.Builtin.Dictionary.ValueAtKey(dictionary=valueAtKey_19, key=code_block_53)
byWidthLength = Rectangle.ByWidthLength(width=valueAtKey_20, length=valueAtKey_21)
center = Polygon.Center(polygon=byWidthLength)
ZAxis_2 = Vector.ZAxis()
code_block_54 = CodeBlock { [0,90,180,270]; }
count_4 = List.Count(list=byWidthLength@L2)
code_block_55 = CodeBlock { 0; 3; }
count_5 = List.Count(list=count_4@L2)
code_block_56 = CodeBlock { 0; 999; }
code_block_57 = CodeBlock { "RotatingSeed"; }
valueAtKey_22 = DesignScript.Builtin.Dictionary.ValueAtKey(dictionary=code_block_48, key=code_block_57)
randomList_2 = Math.RandomList(amount=count_5, value1=code_block_56.out0, value2=code_block_56.out1, seed=valueAtKey_22)
randomList_3 = Math.RandomList(amount=count_4@L2, value1=code_block_55.out0, value2=code_block_55.out1, seed=randomList_2@L2)
round = Math.Round(number=randomList_3)
getItemAtIndex_3 = List.GetItemAtIndex(list=code_block_54, index=round)
flatten_4 = List.Flatten(list=getItemAtIndex_3@L2)
rotate_2 = Geometry.Rotate(geometry=byWidthLength, origin=center, axis=ZAxis_2, degrees=flatten_4)
code_block_58 = CodeBlock(RotatedRectangle=rotate_2)
# ---------- code_block_58.designscript (3 lines) ----------
{
"RotatedRectangle": _RotatedRectangle
};
# ----------------------------------------
extendsChildDictionaryFromParent_6 = Custom[ExtendsChildDictionaryFromParent](ParentDic=valueAtKey_19, ChildDic=code_block_58)
setValueAtKeys_3 = DesignScript.Builtin.Dictionary.SetValueAtKeys(dictionary=code_block_48, keys=code_block_50, values=extendsChildDictionaryFromParent_6.dictionary)

# group: Bldg 장변 방향 종속 Space 처리
code_block_59 = CodeBlock(InputDic=setValueAtKeys_3) { _InputDic; }
code_block_60 = CodeBlock { "BoxClass_nonfixedclustered"; }
removeKeys = DesignScript.Builtin.Dictionary.RemoveKeys(dictionary=code_block_59, keys=code_block_60)
code_block_61 = CodeBlock { "BoxClass_nonfixedclustered"; }
valueAtKey_23 = DesignScript.Builtin.Dictionary.ValueAtKey(dictionary=code_block_59, key=code_block_61)
code_block_62 = CodeBlock { "RotatedRectangle"; }
removeKeys_2 = DesignScript.Builtin.Dictionary.RemoveKeys(dictionary=valueAtKey_23, keys=code_block_62)
code_block_63 = CodeBlock { "BoxRotate"; }
valueAtKey_24 = DesignScript.Builtin.Dictionary.ValueAtKey(dictionary=valueAtKey_23, key=code_block_63)
code_block_64 = CodeBlock(i=valueAtKey_24) { i==1?true:false; }
code_block_65 = CodeBlock { "RotatedRectangle"; }
valueAtKey_25 = DesignScript.Builtin.Dictionary.ValueAtKey(dictionary=valueAtKey_23, key=code_block_65)
rotatedRectangle = CodeBlock(RotatedRectangle=valueAtKey_25) { RotatedRectangle; }
center_2 = Polygon.Center(polygon=rotatedRectangle)
ZAxis_3 = Vector.ZAxis()
code_block_66 = CodeBlock { "BldgBoundary"; }
valueAtKey_26 = DesignScript.Builtin.Dictionary.ValueAtKey(dictionary=code_block_59, key=code_block_66)
explode = Geometry.Explode(geometry=valueAtKey_26)
flatten_5 = List.Flatten(list=explode)
direction = Line.Direction(line=flatten_5)
length = Vector.Length(vector=direction)
maximumItem = List.MaximumItem(list=length)
indexOf = List.IndexOf(list=length, element=maximumItem)
getItemAtIndex_4 = List.GetItemAtIndex(list=direction, index=indexOf)
normalized = Vector.Normalized(vector=getItemAtIndex_4)
X_5 = Vector.X(vector=normalized)
round_2 = Math.Round(number=X_5)
Y_5 = Vector.Y(vector=normalized)
round_3 = Math.Round(number=Y_5)
code_block_67 = CodeBlock(i=round_2, j=round_3) { i<0 || j<0?true:false; }
reverse = Vector.Reverse(vector=normalized)
if_2 = If(test=code_block_67, true=reverse, false=normalized)
explode_2 = Geometry.Explode(geometry=valueAtKey_25)
flatten_6 = List.Flatten(list=explode_2@L2)
direction_2 = Line.Direction(line=flatten_6)
length_2 = Vector.Length(vector=direction_2)
maximumItem_2 = List.MaximumItem(list=length_2)
indexOf_2 = List.IndexOf(list=length_2@L2, element=maximumItem_2@L1)
getItemAtIndex_5 = List.GetItemAtIndex(list=direction_2@L2, index=indexOf_2@L1)
normalized_2 = Vector.Normalized(vector=getItemAtIndex_5)
X_6 = Vector.X(vector=normalized_2)
round_4 = Math.Round(number=X_6)
Y_6 = Vector.Y(vector=normalized_2)
round_5 = Math.Round(number=Y_6)
code_block_68 = CodeBlock(i=round_4, j=round_5) { i<0 || j<0?true:false; }
reverse_2 = Vector.Reverse(vector=normalized_2)
if_3 = If(test=code_block_68, true=reverse_2, false=normalized_2)
angleWithVector = Vector.AngleWithVector(vector=if_2, otherVector=if_3)
round_6 = Math.Round(number=angleWithVector)
rotate_3 = Geometry.Rotate(geometry=rotatedRectangle, origin=center_2, axis=ZAxis_3, degrees=round_6)
if_4 = If(test=code_block_64, true=rotate_3, false=rotatedRectangle)
code_block_69 = CodeBlock(RotatedRectangle=if_4)  # same code as code_block_58
extendsChildDictionaryFromParent_7 = Custom[ExtendsChildDictionaryFromParent](ParentDic=removeKeys_2, ChildDic=code_block_69)
code_block_70 = CodeBlock(BoxClass_nonfixedclu=extendsChildDictionaryFromParent_7.dictionary)  # same code as code_block_47
extendsChildDictionaryFromParent_8 = Custom[ExtendsChildDictionaryFromParent](ParentDic=removeKeys, ChildDic=code_block_70)

# group: 클러스터링 사각형들 Zvalue 맞춰 층별배치하기
code_block_71 = CodeBlock(InputDic=extendsChildDictionaryFromParent_8.dictionary) { _InputDic; }
code_block_72 = CodeBlock { "BoxClass_nonfixedclustered"; }
removeKeys_3 = DesignScript.Builtin.Dictionary.RemoveKeys(dictionary=code_block_71, keys=code_block_72)
code_block_73 = CodeBlock { "BoxClass_nonfixedclustered"; }
valueAtKey_27 = DesignScript.Builtin.Dictionary.ValueAtKey(dictionary=code_block_71, key=code_block_73)
code_block_74 = CodeBlock { "RotatedRectangle"; }
removeKeys_4 = DesignScript.Builtin.Dictionary.RemoveKeys(dictionary=valueAtKey_27, keys=code_block_74)
code_block_75 = CodeBlock { "RotatedRectangle"; }
valueAtKey_28 = DesignScript.Builtin.Dictionary.ValueAtKey(dictionary=valueAtKey_27, key=code_block_75)
code_block_76 = CodeBlock { "BoxZvalue"; }
valueAtKey_29 = DesignScript.Builtin.Dictionary.ValueAtKey(dictionary=valueAtKey_27, key=code_block_76)
translate = Geometry.Translate(geometry=valueAtKey_28, zTranslation=valueAtKey_29)
code_block_77 = CodeBlock(RotatedRectangle=translate)  # same code as code_block_58
extendsChildDictionaryFromParent_9 = Custom[ExtendsChildDictionaryFromParent](ParentDic=removeKeys_4, ChildDic=code_block_77)
code_block_78 = CodeBlock(BoxClass_nonfixedclu=extendsChildDictionaryFromParent_9.dictionary)  # same code as code_block_47
extendsChildDictionaryFromParent_10 = Custom[ExtendsChildDictionaryFromParent](ParentDic=removeKeys_3, ChildDic=code_block_78)

# group: 사각형 Surfaces 흔들어 배치
code_block_79 = CodeBlock(InputDic=extendsChildDictionaryFromParent_10.dictionary) { _InputDic; }
code_block_80 = CodeBlock { "BoxClass_nonfixedclustered"; }
removeKeys_5 = DesignScript.Builtin.Dictionary.RemoveKeys(dictionary=code_block_79, keys=code_block_80)
code_block_81 = CodeBlock { "BoxClass_nonfixedclustered"; }
valueAtKey_30 = DesignScript.Builtin.Dictionary.ValueAtKey(dictionary=code_block_79, key=code_block_81)
code_block_82 = CodeBlock { "RotatedRectangle"; }
valueAtKey_31 = DesignScript.Builtin.Dictionary.ValueAtKey(dictionary=valueAtKey_30, key=code_block_82)
byPatch = Surface.ByPatch(closedCurve=valueAtKey_31)
code_block_83 = CodeBlock { "BldgBoundary"; }
valueAtKey_32 = DesignScript.Builtin.Dictionary.ValueAtKey(dictionary=code_block_79, key=code_block_83)
watch_3 = Watch(valueAtKey_32)
byPatch_2 = Surface.ByPatch(closedCurve=watch_3)
code_block_84 = CodeBlock { 0.5; }
pointAtParameter = Surface.PointAtParameter(surface=byPatch_2, u=code_block_84, v=code_block_84)
X_7 = Point.X(point=pointAtParameter)
Y_7 = Point.Y(point=pointAtParameter)
Z = Point.Z(point=pointAtParameter)
byOrigin = CoordinateSystem.ByOrigin(x=X_7, y=Y_7, z=Z)
explode_3 = Geometry.Explode(geometry=watch_3)
length_3 = Curve.Length(curve=explode_3)
maximumItem_3 = List.MaximumItem(list=length_3)
minimumItem = List.MinimumItem(list=length_3)
count_6 = List.Count(list=valueAtKey_31@L2)

watch_4 = Watch(byPatch)
code_block_85 = CodeBlock(a=watch_4) { a[0..1]; }
watch_5 = Watch(code_block_85)
code_block_86 = CodeBlock(a=watch_4) { a[2..4]; }
watch_6 = Watch(code_block_86)
flatten_7 = List.Flatten(list=watch_6)
list_create = List.Create(item0=flatten_7)
watch_7 = Watch(list_create)
code_block_87 = CodeBlock(a=watch_4) { a[5..6]; }
watch_8 = Watch(code_block_87)
join = List.Join(list0=watch_5, list1=watch_7, list2=watch_8)
watch_9 = Watch(join)

# group (continued): 사각형 Surfaces 흔들어 배치
shakeRoomSurfaces = Custom[ShakeRoomSurfaces](i=watch_9, CS=byOrigin, W=maximumItem_3, L=minimumItem)  # ShakeRoomSurfaces

watch_10 = Watch(shakeRoomSurfaces)
watch_11 = Watch(watch_10)
code_block_88 = CodeBlock(a=watch_11) { a[0..1]; }
watch_12 = Watch(code_block_88)
code_block_89 = CodeBlock(a=watch_11) { a[2]; }
watch_13 = Watch(code_block_89)
code_block_90 = CodeBlock { 1; }
chop = List.Chop(list=watch_13, lengths=code_block_90)
watch_14 = Watch(chop)
code_block_91 = CodeBlock(a=watch_11) { a[3..4]; }
watch_15 = Watch(code_block_91)
join_2 = List.Join(list0=watch_12, list1=watch_14, list2=watch_15)
watch_16 = Watch(join_2)
watch_17 = Watch(watch_16)
watch_18 = Watch(watch_17)
code_block_92 = CodeBlock { -2; }
dropItems = List.DropItems(list=watch_18, amount=code_block_92)
code_block_93 = CodeBlock(a=watch_18) { a[5]; }
byJoinedSurfaces = PolySurface.ByJoinedSurfaces(surfaces=code_block_93)
watch_19 = Watch(byJoinedSurfaces)
perimeterCurves = Surface.PerimeterCurves(surface=code_block_93)
startPoint_2 = Curve.StartPoint(curve=perimeterCurves)
flatten_8 = List.Flatten(list=startPoint_2)
pruneDuplicates = Point.PruneDuplicates(points=flatten_8)
python_script = Python(IN[0]=pruneDuplicates)  # IronPython2
# ---------- python_script.python (55 lines) ----------
import clr
clr.AddReference('ProtoGeometry')
from Autodesk.DesignScript.Geometry import *

def ToVals(pt):
	return [pt.X,pt.Y,pt.Z]

def ToPts(ptVals):
	return Point.ByCoordinates(ptVals[0],ptVals[1],ptVals[2])

def CreateOutline(pts):
	crvs = []
	i = 0
	while i < len(pts):
		if i == len(pts)-1:
			crvs.append(Line.ByStartPointEndPoint(pts[i],pts[0]))
		else:
			crvs.append(Line.ByStartPointEndPoint(pts[i],pts[i+1]))
		i = i+1
	return PolyCurve.ByJoinedCurves(crvs)

'''
Taken from Thomas Switzers awesome GitHub repo and modified to suit Dynamo Context
https://gist.github.com/arthur-e/5cf52962341310f438e96c1f3c3398b8
I take zero credit for this work other than porting it across.
'''
def convex_hull_graham(points):
	'''
	Returns points on convex hull in CCW order according to Graham's scan algorithm. 
	By Tom Switzer <thomas.switzer@gmail.com>.
	'''
	TURN_LEFT, TURN_RIGHT, TURN_NONE = (1, -1, 0)

	def cmp(a, b):
		return (a > b) - (a < b)
	
	def turn(p, q, r):
		return cmp((q[0] - p[0])*(r[1] - p[1]) - (r[0] - p[0])*(q[1] - p[1]), 0)
	
	def _keep_left(hull, r):
		while len(hull) > 1 and turn(hull[-2], hull[-1], r) != TURN_LEFT:
			hull.pop()
		if not len(hull) or hull[-1] != r:
			hull.append(r)
		return hull

	points = [ToVals(p) for p in points]	
	points = sorted(points)
	l = reduce(_keep_left, points, [])
	u = reduce(_keep_left, reversed(points), [])
	points = l.extend(u[i] for i in range(1, len(u) - 1)) or l
	points = [ToPts(p) for p in points]
	return CreateOutline(points)

OUT = convex_hull_graham(IN[0])
# ----------------------------------------
byPatch_3 = Surface.ByPatch(closedCurve=python_script)
difference = Surface.Difference(surface=byPatch_3, others=byJoinedSurfaces)
count_7 = List.Count(list=difference)
code_block_94 = CodeBlock(a=count_7) { a>1; }
surfaces = PolySurface.Surfaces(polySurface=difference)
if_5 = If(test=code_block_94, true=surfaces, false=difference)
watch_20 = Watch(python_script)
code_block_95 = CodeBlock { -50; }
offset = Curve.Offset(curve=watch_20, distance=code_block_95)
code_block_96 = CodeBlock { 50; }
offset_2 = Curve.Offset(curve=watch_20, distance=code_block_96)
list_create_2 = List.Create(item0=offset, item1=offset_2)
flatten_9 = List.Flatten(list=list_create_2)
byLoft = Surface.ByLoft(crossSections=flatten_9)
code_block_97 = CodeBlock { 50; }
thicken = Surface.Thicken(surface=byLoft, thickness=code_block_97)
doesIntersect_2 = Geometry.DoesIntersect(geometry=thicken, other=if_5, lacing=Longest)
filterByBoolMask_2 = List.FilterByBoolMask(list=if_5, mask=doesIntersect_2)
flatten_10 = List.Flatten(list=filterByBoolMask_2.in)
perimeterCurves_2 = Surface.PerimeterCurves(surface=flatten_10)
startPoint_3 = Curve.StartPoint(curve=perimeterCurves_2)
flatten_11 = List.Flatten(list=startPoint_3)
code_block_98 = CodeBlock { 1; }
pruneDuplicates_2 = Point.PruneDuplicates(points=flatten_11, tolerance=code_block_98)
doesIntersect_3 = Geometry.DoesIntersect(geometry=thicken, other=pruneDuplicates_2)
filterByBoolMask_3 = List.FilterByBoolMask(list=pruneDuplicates_2, mask=doesIntersect_3)
watch_21 = Watch(filterByBoolMask_3.in)
flatten_12 = List.Flatten(list=watch_21)
firstItem_3 = List.FirstItem(list=flatten_12)
ZAxis_4 = Vector.ZAxis()
code_block_99 = CodeBlock { 0..270..90; }
rotate_4 = Geometry.Rotate(geometry=watch_19, origin=firstItem_3, axis=ZAxis_4, degrees=code_block_99)
code_block_100 = CodeBlock(a=watch_18) { a[6]; }
python_script_20210913 = Python(IN[0]=code_block_100)  # CPython3; unwired: IN[1]
# ---------- python_script_20210913.python (198 lines) ----------
# Load the Python Standard and DesignScript Libraries
from random import randint
import sys
import clr
clr.AddReference('ProtoGeometry')
from Autodesk.DesignScript.Geometry import *
clr.AddReference('DSCoreNodes')
from DSCore import *
from DSCore import Color
clr.AddReference('GeometryColor')
from Modifiers import GeometryColor
from functools import reduce

# The inputs to this node will be stored as a list in the IN variables.
##############################
dataEnteringNode = IN
InList = IN[0]
PlacingBoundary = IN[1]

PrePlacingList = []
PostPlacingList = []

###########################################################################
class FuncCurrying:
    pass

class ConvexHull_Maker:
    def __init__(self, points):
        def convex_hull_graham(points):
            def ToVals(pt):
	            return [pt.X,pt.Y,pt.Z]
            def ToPts(ptVals):
	            return Point.ByCoordinates(ptVals[0],ptVals[1],ptVals[2])
	           
            def CreateOutline(pts):
                crvs = []
                i = 0
                while i < len(pts):
                    if i == len(pts)-1:
                        crvs.append(Line.ByStartPointEndPoint(pts[i],pts[0]))
                    else:
                        crvs.append(Line.ByStartPointEndPoint(pts[i],pts[i+1]))
                    i = i+1
                return PolyCurve.ByJoinedCurves(crvs)
	
            TURN_LEFT, TURN_RIGHT, TURN_NONE = (1, -1, 0)

            def cmp(a, b):
                return (a > b) - (a < b)
	
            def turn(p, q, r):
                return cmp((q[0] - p[0])*(r[1] - p[1]) - (r[0] - p[0])*(q[1] - p[1]), 0)
	
            def _keep_left(hull, r):
                while len(hull) > 1 and turn(hull[-2], hull[-1], r) != TURN_LEFT:
                    hull.pop()
                if not len(hull) or hull[-1] != r:
                    hull.append(r)
                return hull

            points = [ToVals(p) for p in points]	
            points = sorted(points)
            l = reduce(_keep_left, points, [])
            u = reduce(_keep_left, reversed(points), [])
            points = l.extend(u[i] for i in range(1, len(u) - 1)) or l
            points = [ToPts(p) for p in points]
            return CreateOutline(points)
            
        self.points = points
        result = convex_hull_graham(points)
        self.result = result

class Qluster:
    def __init__(self, cl):
        def create_joinedSrf(cl):
            return PolySurface.ByJoinedSurfaces(cl)
        def find_periCrvsOn_srf(srf):
            return srf.PerimeterCurves()
        def get_PointOf_PeriCrvs(crvs):
            return list(map(lambda x: x.StartPoint,crvs))
        def get_cvxHullFor_cl(cl):
            return ConvexHull_Maker(cl).result
        def create_offsetCrv(crv, offset):
            return Curve.Offset(crv, offset)
        def create_bdrySolid_forInsp(pcrv):
            offin_cvx_crv = Curve.Offset(pcrv,-10)
            offout_cvx_crv = Curve.Offset(pcrv,300)
            cvx_bdry_srf = Surface.ByLoft([offout_cvx_crv, offin_cvx_crv])
            cvx_bdry_solid = Surface.Thicken(cvx_bdry_srf, 1, True)
            return cvx_bdry_solid
        def patch_pCrv(pcrv):
            return Surface.ByPatch(pcrv)
        def find_boundary_point(cl):
            pass
            
        self.cl = cl
        
        psrf = create_joinedSrf(cl)
        self.psrf = psrf
        
        crvs = find_periCrvsOn_srf(psrf)
        self.crvs = crvs
        
        startpt_crv = get_PointOf_PeriCrvs(crvs)
        self.startpt_crv = startpt_crv
        
        crv_cvxHull = get_cvxHullFor_cl(startpt_crv)
        self.crv_cvxHull = crv_cvxHull
        
        crv_cvxHull_offin = create_offsetCrv(crv_cvxHull, -10)
        bdrysolid_cvxHull = create_bdrySolid_forInsp(crv_cvxHull)
        self.bdrysolid_cvxHull = bdrysolid_cvxHull
        
        patched_cvxHull = patch_pCrv(crv_cvxHull)

        try:
            diff_srf = Surface.Difference(patched_cvxHull, cl)
            if isinstance(diff_srf, PolySurface):
                div_diff_srflist = PolySurface.Surfaces(diff_srf)
            else:
                div_diff_srflist = [diff_srf]
        except:
            div_diff_srflist = [patched_cvxHull]
        self.div_diff_srflist = div_diff_srflist
        
        outer_srf_diff = list(
        filter(lambda x: Geometry.DoesIntersect(x, bdrysolid_cvxHull), div_diff_srflist))
        self.outer_srf_diff = outer_srf_diff
        inner_srf_diff = list(
        filter(lambda x: Geometry.DoesIntersect(x, bdrysolid_cvxHull) == False, div_diff_srflist))
        if len(inner_srf_diff) == 0:
            pt_cl_bdry = startpt_crv
        else:
            joined_inner_srf = PolySurface.ByJoinedSurfaces(inner_srf_diff)
            pre_pt_cl_bdry = list(
            filter(lambda x: Geometry.DoesIntersect(x, joined_inner_srf) == False, startpt_crv))
            pt_cl_bdry = list(
            filter(lambda x: Geometry.DoesIntersect(x, patch_pCrv(crv_cvxHull_offin)) == False, pre_pt_cl_bdry))
        crvlist_outer_srf = list(map(find_periCrvsOn_srf, outer_srf_diff))
        pt_outer_srf = sum(list(map(get_PointOf_PeriCrvs, crvlist_outer_srf)),[])
        self.pt_outer_srf = pt_outer_srf
        pt_cvx_bdry = list(filter(lambda x: Geometry.DoesIntersect(x, bdrysolid_cvxHull), pt_outer_srf))
 
        preip = list(filter(lambda x: Geometry.DoesIntersect(x, bdrysolid_cvxHull) != True, pt_outer_srf))
        
        def f_nip(x):
            return filter(lambda y: Geometry.DoesIntersect(x, y) == False, cir_ip)

        if len(preip) == 0:
            minX = min(map(lambda x: round(x.X,3), pt_outer_srf))
            maxY = max(map(lambda x: round(x.Y,3), pt_outer_srf))
            pt_X = list(filter(lambda x: round(x.X,3) == minX, pt_outer_srf))
            ip = list(filter(lambda x: round(x.Y,3) == maxY, pt_X))
            cir_ip = list(map(lambda x: Sphere.ByCenterPointRadius(x,1), ip))
            uni_cir_ip = Solid.ByUnion(cir_ip)
            nip = list(filter(lambda x: Geometry.DoesIntersect(x, uni_cir_ip) == False, pt_cl_bdry))
        else:
            ip = list(filter(lambda x: Geometry.DoesIntersect(x, bdrysolid_cvxHull) != True, pt_outer_srf))
            cir_ip = list(map(lambda x: Sphere.ByCenterPointRadius(x,1), ip))
            uni_cir_ip = Solid.ByUnion(cir_ip)
            nip = list(filter(lambda x: Geometry.DoesIntersect(x, uni_cir_ip) == False, pt_cl_bdry))
        self.cir_ip = cir_ip
        self.ip = ip
        self.nip = nip
        qcircle_ip = list(map(lambda x: Sphere.ByCenterPointRadius(x,500), ip))
        self.qcircle_ip = qcircle_ip
        qcircle_nip = list(map(lambda x: Sphere.ByCenterPointRadius(x,500), nip))
        self.qcircle_nip = qcircle_nip

class Qplacer: ## clst: cluster set, cl: cluster, clem: cluster elements
    pass



# Place your code below this line
def colorize(i,r,g,b):
	return GeometryColor.ByGeometryColor(i, Color.ByARGB(125, r, g, b))


a = Qluster(InList).cl
b = Qluster(InList).crvs
c = Qluster(InList).startpt_crv
d = Qluster(InList).crv_cvxHull
e = colorize(Qluster(InList).bdrysolid_cvxHull, 255,0,0)
f = list(map(lambda x: colorize(x,0,125,0),Qluster(InList).qcircle_ip))
g = Qluster(InList).pt_outer_srf
h = Qluster(InList).ip
i = list(map(lambda x: colorize(x,0,0,125),Qluster(InList).qcircle_nip))
#b = Qluster(InList).startpt_crv
#c = Qluster(InList).crv_convexhull_clst
#d = []
#for i in ClusterComplex(InList).bdrysolid_convexhull_clst:
#    d.append(GeometryColor.ByGeometryColor(i, Color.ByARGB(125, 255, 0, 0)))
#d = list(map(lambda i: f_vision(i,255,0,0), Qluster(InList).bdrysolid_convexhull_clst))
#f = ClusterComplex(InList).crvs
#f = list(map(lambda i: f_vision(i,125,0,0),ClusterComplex(InList).bdrysolid_peri_clst))
# Assign your output to the OUT variable.
OUT = (b,d,e,f,h,i)
# ----------------------------------------
watch_22 = Watch(python_script_20210913)
code_block_101 = CodeBlock(a=watch_22) { a[4]; }
flatten_13 = List.Flatten(list=code_block_101)
byTwoPoints = Vector.ByTwoPoints(start=firstItem_3, end=flatten_13)
translate_2 = Geometry.Translate(geometry=rotate_4@L2, direction=byTwoPoints, lacing=Longest)
flatten_14 = List.Flatten(list=translate_2)
byJoinedSurfaces_2 = PolySurface.ByJoinedSurfaces(surfaces=code_block_100)
watch_23 = Watch(byJoinedSurfaces_2)
thicken_2 = Surface.Thicken(surface=watch_23)
thicken_3 = Surface.Thicken(surface=flatten_14)
intersect = Geometry.Intersect(geometry=thicken_2, other=thicken_3)
count_8 = List.Count(list=intersect@L2)
code_block_102 = CodeBlock(a=count_8) { a>1; }
filterByBoolMask_4 = List.FilterByBoolMask(list=flatten_14, mask=code_block_102)
flatten_15 = List.Flatten(list=filterByBoolMask_4.in)
lastItem = List.LastItem(list=flatten_12)
ZAxis_5 = Vector.ZAxis()
code_block_103 = CodeBlock { 0..270..90; }
rotate_5 = Geometry.Rotate(geometry=watch_19, origin=lastItem, axis=ZAxis_5, degrees=code_block_103)
byTwoPoints_2 = Vector.ByTwoPoints(start=lastItem, end=flatten_13)
translate_3 = Geometry.Translate(geometry=rotate_5@L2, direction=byTwoPoints_2, lacing=Longest)
flatten_16 = List.Flatten(list=translate_3)
watch_24 = Watch(byJoinedSurfaces_2)
thicken_4 = Surface.Thicken(surface=watch_24)
thicken_5 = Surface.Thicken(surface=flatten_16)
intersect_2 = Geometry.Intersect(geometry=thicken_4, other=thicken_5)
count_9 = List.Count(list=intersect_2@L2)
code_block_104 = CodeBlock(a=count_9) { a>1; }
filterByBoolMask_5 = List.FilterByBoolMask(list=flatten_16, mask=code_block_104)
flatten_17 = List.Flatten(list=filterByBoolMask_5.in)
join_3 = List.Join(list0=flatten_15, list1=flatten_17)
watch_25 = Watch(watch_3)
byPatch_4 = Surface.ByPatch(closedCurve=watch_25)
code_block_105 = CodeBlock { 50000; }
thicken_6 = Surface.Thicken(surface=byPatch_4, thickness=code_block_105)
intersect_3 = Geometry.Intersect(geometry=thicken_6, other=join_3, lacing=Longest)
area = Surface.Area(surface=intersect_3)
sum = Math.Sum(values=area)
maximumItem_4 = List.MaximumItem(list=sum)
eq = maximumItem_4 == sum
filterByBoolMask_6 = List.FilterByBoolMask(list=join_3, mask=eq)
flatten_18 = List.Flatten(list=filterByBoolMask_6.in)
explode_4 = Geometry.Explode(geometry=flatten_18)
flatten_19 = List.Flatten(list=explode_4)
watch_26 = Watch(flatten_19)
list_create_3 = List.Create(item0=watch_26)
watch_27 = Watch(code_block_100)
list_create_4 = List.Create(item0=watch_27)
join_4 = List.Join(list0=dropItems, list1=list_create_3, list2=list_create_4)

# group (continued): 사각형 Surfaces 흔들어 배치
flatten_20 = List.Flatten(list=join_4)
chop_2 = List.Chop(list=flatten_20, lengths=count_6)
code_block_106 = CodeBlock(ShakedSurfaces=chop_2)
# ---------- code_block_106.designscript (3 lines) ----------
{
"ShakedSurfaces": _ShakedSurfaces
};
# ----------------------------------------
extendsChildDictionaryFromParent_11 = Custom[ExtendsChildDictionaryFromParent](ParentDic=valueAtKey_30, ChildDic=code_block_106)
code_block_107 = CodeBlock(BoxClass_nonfixedclu=extendsChildDictionaryFromParent_11.dictionary)  # same code as code_block_47
extendsChildDictionaryFromParent_12 = Custom[ExtendsChildDictionaryFromParent](ParentDic=removeKeys_5, ChildDic=code_block_107)

color_palette = ColorPalette({R: 255, G: 215, B: 0, A: 150})
color_palette_2 = ColorPalette({R: 220, G: 20, B: 60, A: 150})
color_palette_3 = ColorPalette({R: 70, G: 130, B: 180, A: 150})
color_palette_4 = ColorPalette({R: 238, G: 130, B: 238, A: 150})
color_palette_5 = ColorPalette({R: 50, G: 205, B: 50, A: 150})
color_palette_6 = ColorPalette({R: 255, G: 127, B: 80, A: 150})
list_create_5 = List.Create(item0=color_palette, item1=color_palette_2, item2=color_palette_3, item3=color_palette_4, item4=color_palette_5, item5=color_palette_6)

# group: 부서별 색상 지정
code_block_108 = CodeBlock()
# ---------- code_block_108.designscript (6 lines) ----------
color1 = Color.ByARGB(150, 200, 0, 0);
color2 = Color.ByARGB(150, 0, 200, 0);
color3 = Color.ByARGB(150, 0, 0, 200);
color4 = Color.ByARGB(200, 0, 0, 200);
color5 = Color.ByARGB(200, 200, 0, 100);
color6 = Color.ByARGB(200, 0, 200, 0);
# ----------------------------------------
remember_3 = Data.Remember(code_block_108.color4)
remember_4 = Data.Remember(code_block_108.color5)
remember_5 = Data.Remember(code_block_108.color1)
remember_6 = Data.Remember(code_block_108.color2)
remember_7 = Data.Remember(code_block_108.color3)
join_5 = List.Join(list0=remember_5, list1=remember_6, list2=remember_7)
remember_8 = Data.Remember(code_block_108.color6)
code_block_109 = CodeBlock(InputDic=extendsChildDictionaryFromParent_12.dictionary) { _InputDic; }
code_block_110 = CodeBlock { "BoxClass_nonfixedclustered"; }
valueAtKey_33 = DesignScript.Builtin.Dictionary.ValueAtKey(dictionary=code_block_109, key=code_block_110)
code_block_111 = CodeBlock { "BoxDepartment"; }
valueAtKey_34 = DesignScript.Builtin.Dictionary.ValueAtKey(dictionary=valueAtKey_33, key=code_block_111)
watch_28 = Watch(valueAtKey_34)
uniqueItems_4 = List.UniqueItems(list=watch_28)
flatten_21 = List.Flatten(list=uniqueItems_4)
byKeysValues_3 = DesignScript.Builtin.Dictionary.ByKeysValues(keys=flatten_21, values=list_create_5)
code_block_112 = CodeBlock(DepartmentColorDic=byKeysValues_3)
# ---------- code_block_112.designscript (3 lines) ----------
{
"DepartmentColorDic": _DepartmentColorDic
};
# ----------------------------------------
extendsChildDictionaryFromParent_13 = Custom[ExtendsChildDictionaryFromParent](ParentDic=code_block_109, ChildDic=code_block_112)

code_block_113 = CodeBlock { "BoxClass_nonfixedclustered"; }
code_block_114 = CodeBlock { "ShakedSurfaces"; }

# group: 사각 공간 색상 지정
code_block_115 = CodeBlock(InputDic=extendsChildDictionaryFromParent_13.dictionary) { _InputDic; }
code_block_116 = CodeBlock { "BoxHeight"; }
boolean_2 = BoolSelector(false)
code_block_117 = CodeBlock { "DepartmentColorDic"; }
valueAtKey_35 = DesignScript.Builtin.Dictionary.ValueAtKey(dictionary=code_block_115, key=code_block_117)
code_block_118 = CodeBlock { "BoxDepartment"; }
code_block_119 = CodeBlock { "BoxSpaceID"; }

valueAtKey_36 = DesignScript.Builtin.Dictionary.ValueAtKey(dictionary=code_block_115, key=code_block_113)

# group (continued): 사각 공간 색상 지정
valueAtKey_37 = DesignScript.Builtin.Dictionary.ValueAtKey(dictionary=valueAtKey_36, key=code_block_114)
valueAtKey_38 = DesignScript.Builtin.Dictionary.ValueAtKey(dictionary=valueAtKey_36, key=code_block_116)
thicken_7 = Surface.Thicken(surface=valueAtKey_37, thickness=valueAtKey_38, both_sides=boolean_2)
valueAtKey_39 = DesignScript.Builtin.Dictionary.ValueAtKey(dictionary=valueAtKey_36, key=code_block_118)
valueAtKey_40 = DesignScript.Builtin.Dictionary.ValueAtKey(dictionary=valueAtKey_36, key=code_block_119)
flatten_22 = List.Flatten(list=valueAtKey_40)
code_block_120 = CodeBlock(RoomSolid=thicken_7)
# ---------- code_block_120.designscript (3 lines) ----------
{
"RoomSolid": _RoomSolid
};
# ----------------------------------------
extendsChildDictionaryFromParent_14 = Custom[ExtendsChildDictionaryFromParent](ParentDic=code_block_115, ChildDic=code_block_120)

flatten_23 = List.Flatten(list=valueAtKey_39)

# group (continued): 사각 공간 색상 지정
valueAtKey_41 = DesignScript.Builtin.Dictionary.ValueAtKey(dictionary=valueAtKey_35, key=flatten_23)
byGeometryColor = Modifiers.GeometryColor.ByGeometryColor(geometry=thicken_7, color=valueAtKey_41)
getItemAtIndex_6 = List.GetItemAtIndex(list=flatten_23, index=flatten_22)

watch_29 = Watch(extendsChildDictionaryFromParent_12.dictionary)
origin = Point.Origin()
origin_2 = Point.Origin()
watch_30 = Watch(filterByBoolMask_3.out)
flatten_24 = List.Flatten(list=watch_30)
code_block_121 = CodeBlock { 1000; }
code_block_122 = CodeBlock(a=maximumItem_4) { a/1000000; }
output_area = Math.Round(number=code_block_122)  # graph output

# group: GD Output - difference area to minimum
code_block_123 = CodeBlock(InputDic=extendsChildDictionaryFromParent_14.dictionary) { _InputDic; }
code_block_124 = CodeBlock { "ShakedSurfaces"; }
code_block_125 = CodeBlock { "BoxZvalue"; }
code_block_126 = CodeBlock { "BldgBoundary"; }
valueAtKey_42 = DesignScript.Builtin.Dictionary.ValueAtKey(dictionary=code_block_123, key=code_block_126)
basePlane = PolyCurve.BasePlane(polyCurve=valueAtKey_42)
firstItem_4 = List.FirstItem(list=basePlane)
code_block_127 = CodeBlock { 1; }
code_block_128 = CodeBlock { 10; }
offset_3 = Curve.Offset(curve=valueAtKey_42, distance=code_block_128)

code_block_129 = CodeBlock { "BoxClass_nonfixedclustered"; }
valueAtKey_43 = DesignScript.Builtin.Dictionary.ValueAtKey(dictionary=code_block_123, key=code_block_129)

# group (continued): GD Output - difference area to minimum
valueAtKey_44 = DesignScript.Builtin.Dictionary.ValueAtKey(dictionary=valueAtKey_43, key=code_block_124)
flatten_25 = List.Flatten(list=valueAtKey_44)
valueAtKey_45 = DesignScript.Builtin.Dictionary.ValueAtKey(dictionary=valueAtKey_43, key=code_block_125)
flatten_26 = List.Flatten(list=valueAtKey_45)
uniqueItems_5 = List.UniqueItems(list=flatten_26)
allIndicesOf_2 = List.AllIndicesOf(list=flatten_26, item=uniqueItems_5)

perimeterCurves_3 = Surface.PerimeterCurves(surface=flatten_25)
byJoinedCurves_2 = PolyCurve.ByJoinedCurves(curves=perimeterCurves_3)
flatten_27 = List.Flatten(list=allIndicesOf_2)

# group (continued): GD Output - difference area to minimum
getItemAtIndex_7 = List.GetItemAtIndex(list=byJoinedCurves_2, index=flatten_27)
pullOntoPlane = Curve.PullOntoPlane(curve=getItemAtIndex_7, plane=firstItem_4)
byPatch_5 = Surface.ByPatch(closedCurve=pullOntoPlane)
split = Geometry.Split(geometry=byPatch_5, other=valueAtKey_42, lacing=CrossProduct)
flatten_28 = List.Flatten(list=split@L2, amt=code_block_127)
flatten_29 = List.Flatten(list=flatten_28)
doesIntersect_4 = Geometry.DoesIntersect(geometry=flatten_29@L2, other=offset_3@L1)
flatten_30 = List.Flatten(list=doesIntersect_4)
filterByBoolMask_7 = List.FilterByBoolMask(list=flatten_29, mask=flatten_30)
area_2 = Surface.Area(surface=filterByBoolMask_7.in)
math_sum_outside_area_of = Math.Sum(values=area_2)  # "Math.Sum@Outside Area of Boundary"

code_block_130 = CodeBlock(a=math_sum_outside_area_of) { a/1000000; }
outside_area_of_boundary = Math.Round(number=code_block_130)  # graph output
explode_5 = Geometry.Explode(geometry=thicken_7)
perimeterCurves_4 = Surface.PerimeterCurves(surface=explode_5)
code_block_131 = CodeBlock { "BoxClass_fixedpart"; }
valueAtKey_46 = DesignScript.Builtin.Dictionary.ValueAtKey(dictionary=code_block_115, key=code_block_131)
code_block_132 = CodeBlock { "BoxGeometry"; }
valueAtKey_47 = DesignScript.Builtin.Dictionary.ValueAtKey(dictionary=valueAtKey_46, key=code_block_132)
explode_6 = Geometry.Explode(geometry=valueAtKey_47)
perimeterCurves_5 = Surface.PerimeterCurves(surface=explode_6)
family_types = FamilyTypes("Space Planning Box_hec:Space Planning Box_hec")
watch_31 = Watch(thicken_7)
watch_32 = Watch(rotate)
join_6 = List.Join(list0=watch_31, list1=watch_32)
gate = Data.Gate(true, join_6)
flatten_31 = List.Flatten(list=gate)
explode_7 = Geometry.Explode(geometry=flatten_31)
code_block_133 = CodeBlock { 0.5; }
pointAtParameter_2 = Surface.PointAtParameter(surface=explode_7, u=code_block_133, v=code_block_133)
code_block_134 = CodeBlock { -1; }
normalAtPoint = Surface.NormalAtPoint(surface=explode_7, point=pointAtParameter_2)
Z_2 = Vector.Z(vector=normalAtPoint)
round_7 = Math.Round(number=Z_2)
watch_33 = Watch(round_7)
eq_2 = code_block_134 == watch_33
filterByBoolMask_8 = List.FilterByBoolMask(list=pointAtParameter_2, mask=eq_2)
watch_34 = Watch(filterByBoolMask_8.in)
flatten_32 = List.Flatten(list=watch_34)
categories = Categories("OST_Levels")
all_elements_of_category = ElementsOfCategory(Category=categories)
elevation = Level.Elevation(level=all_elements_of_category)
string_from_object_2 = FromObject(object=elevation)
Z_3 = Point.Z(point=flatten_32)
string_from_object_3 = FromObject(object=Z_3)
indexOf_3 = List.IndexOf(list=string_from_object_2, element=string_from_object_3)
getItemAtIndex_8 = List.GetItemAtIndex(list=all_elements_of_category, index=indexOf_3)
byPointAndLevel = FamilyInstance.ByPointAndLevel(familyType=family_types, point=flatten_32, level=getItemAtIndex_8)  # frozen
watch_35 = Watch(byPointAndLevel)
code_block_135 = CodeBlock { "Length"; "Width"; "Height"; "Fill Color"; }
byGeometry_2 = BoundingBox.ByGeometry(geom=flatten_31@L1)
toCuboid = BoundingBox.ToCuboid(boundingBox=byGeometry_2)
length_4 = Cuboid.Length(cuboid=toCuboid)
setParameterByName = Element.SetParameterByName(element=watch_35, parameterName=code_block_135.out0, value=length_4)
width = Cuboid.Width(cuboid=toCuboid)
setParameterByName_2 = Element.SetParameterByName(element=watch_35, parameterName=code_block_135.out1, value=width)
height = Cuboid.Height(cuboid=toCuboid)
setParameterByName_3 = Element.SetParameterByName(element=watch_35, parameterName=code_block_135.out2, value=height)
flatten_33 = List.Flatten(list=valueAtKey_39)
code_block_136 = CodeBlock(InputDic=extendsChildDictionaryFromParent_14.dictionary) { _InputDic; }
code_block_137 = CodeBlock { "BoxClass_fixedpart"; }
valueAtKey_48 = DesignScript.Builtin.Dictionary.ValueAtKey(dictionary=code_block_136, key=code_block_137)
code_block_138 = CodeBlock { "BoxDepartment"; }
valueAtKey_49 = DesignScript.Builtin.Dictionary.ValueAtKey(dictionary=valueAtKey_48, key=code_block_138)
join_7 = List.Join(list0=flatten_33, list1=valueAtKey_49)
uniqueItems_6 = List.UniqueItems(list=join_7)
code_block_139 = CodeBlock { "Gray"; "Pink"; "Magenta"; "Purple"; "Lavender"; "Blue"; "Cyan"; "Teal"; "Green"; "Lime"; "Yellow"; "Orange"; "Red"; }
list_create_6 = List.Create(item0=code_block_139.out10, item1=code_block_139.out12, item2=code_block_139.out5, item3=code_block_139.out1, item4=code_block_139.out8, item5=code_block_139.out11)
byKeysValues_4 = DesignScript.Builtin.Dictionary.ByKeysValues(keys=uniqueItems_6, values=list_create_6)
valueAtKey_50 = DesignScript.Builtin.Dictionary.ValueAtKey(dictionary=byKeysValues_4, key=join_7)
string_from_object_4 = FromObject(object=valueAtKey_50)
byName = Material.ByName(name=string_from_object_4)
setParameterByName_4 = Element.SetParameterByName(element=watch_35, parameterName=code_block_135.out3, value=byName)
watch_36 = Watch(list_create_5)
code_block_140 = CodeBlock { "Program Area"; }
code_block_141 = CodeBlock(InputDic=extendsChildDictionaryFromParent_13.dictionary) { _InputDic; }
code_block_142 = CodeBlock { "BoxClass_nonfixedclustered"; }
valueAtKey_51 = DesignScript.Builtin.Dictionary.ValueAtKey(dictionary=code_block_141, key=code_block_142)
code_block_143 = CodeBlock { "BoxDepartment"; "BoxSpaceName"; "BoxArea"; "BoxInteriorFinish"; "BoxExteriorFinish"; }
valueAtKey_52 = DesignScript.Builtin.Dictionary.ValueAtKey(dictionary=valueAtKey_51, key=code_block_143.out2)
watch_37 = Watch(valueAtKey_52)
code_block_144 = CodeBlock { "BoxDepartment"; "BoxSpaceName"; "BoxArea"; "BoxInteriorFinish"; "BoxExteriorFinish"; }
valueAtKey_53 = DesignScript.Builtin.Dictionary.ValueAtKey(dictionary=valueAtKey_48, key=code_block_144.out2)
watch_38 = Watch(valueAtKey_53)
join_8 = List.Join(list0=watch_37, list1=watch_38)
flatten_34 = List.Flatten(list=join_8)
setParameterByName_5 = Element.SetParameterByName(element=watch_35, parameterName=code_block_140, value=flatten_34)
code_block_145 = CodeBlock { "Interior Finish"; }
valueAtKey_54 = DesignScript.Builtin.Dictionary.ValueAtKey(dictionary=valueAtKey_51, key=code_block_143.out3)
watch_39 = Watch(valueAtKey_54)
valueAtKey_55 = DesignScript.Builtin.Dictionary.ValueAtKey(dictionary=valueAtKey_48, key=code_block_144.out3)
watch_40 = Watch(valueAtKey_55)
join_9 = List.Join(list0=watch_39, list1=watch_40)
flatten_35 = List.Flatten(list=join_9)
setParameterByName_6 = Element.SetParameterByName(element=watch_35, parameterName=code_block_145, value=flatten_35)
code_block_146 = CodeBlock { "Exterior Finish"; }
valueAtKey_56 = DesignScript.Builtin.Dictionary.ValueAtKey(dictionary=valueAtKey_51, key=code_block_143.out4)
watch_41 = Watch(valueAtKey_56)
valueAtKey_57 = DesignScript.Builtin.Dictionary.ValueAtKey(dictionary=valueAtKey_48, key=code_block_144.out4)
watch_42 = Watch(valueAtKey_57)
join_10 = List.Join(list0=watch_41, list1=watch_42)
flatten_36 = List.Flatten(list=join_10)
setParameterByName_7 = Element.SetParameterByName(element=watch_35, parameterName=code_block_146, value=flatten_36)
code_block_147 = CodeBlock { "Department"; }
valueAtKey_58 = DesignScript.Builtin.Dictionary.ValueAtKey(dictionary=valueAtKey_51, key=code_block_143.out0)
watch_43 = Watch(valueAtKey_58)
valueAtKey_59 = DesignScript.Builtin.Dictionary.ValueAtKey(dictionary=valueAtKey_48, key=code_block_144.out0)
watch_44 = Watch(valueAtKey_59)
join_11 = List.Join(list0=watch_43, list1=watch_44)
flatten_37 = List.Flatten(list=join_11)
setParameterByName_8 = Element.SetParameterByName(element=watch_35, parameterName=code_block_147, value=flatten_37)
code_block_148 = CodeBlock { "Room Name"; }
valueAtKey_60 = DesignScript.Builtin.Dictionary.ValueAtKey(dictionary=valueAtKey_51, key=code_block_143.out1)
watch_45 = Watch(valueAtKey_60)
valueAtKey_61 = DesignScript.Builtin.Dictionary.ValueAtKey(dictionary=valueAtKey_48, key=code_block_144.out1)
watch_46 = Watch(valueAtKey_61)
join_12 = List.Join(list0=watch_45, list1=watch_46)
flatten_38 = List.Flatten(list=join_12)
setParameterByName_9 = Element.SetParameterByName(element=watch_35, parameterName=code_block_148, value=flatten_38)
X_8 = Point.X(point=flatten_32)
Y_8 = Point.Y(point=flatten_32)
byCoordinates_4 = Point.ByCoordinates(x=X_8, y=Y_8)
룸_boundingbox_그리드_포인트_생성 = Python(IN[0]=code_block_8)  # CPython3; frozen
# ---------- 룸_boundingbox_그리드_포인트_생성.python (35 lines) ----------
# Load the Python Standard and DesignScript Libraries
import sys
import clr
clr.AddReference('ProtoGeometry')
from Autodesk.DesignScript.Geometry import *

# The inputs to this node will be stored as a list in the IN variables.
dataEnteringNode = IN
inputDic = IN[0]
# Place your code below this line

BldgBoundary = inputDic["BldgBoundary"]

#######################################################################
BDbox_BldgBoundary = BoundingBox.ByGeometry(BldgBoundary)
BD_Minpt = BDbox_BldgBoundary.MinPoint
BD_Maxpt = BDbox_BldgBoundary.MaxPoint
a = BD_Minpt.X
b = BD_Maxpt.X
c = BD_Minpt.Y
d = BD_Maxpt.Y

step = 500
x_forGrid = range(a,b,step)
y_forGrid = range(c,d,step)

#GridPts = list(map(lambda x: map(lambda y: Point.ByCoordinates(x, y, 0), y_forGrid), x_forGrid)))

#######################################################################

#BoxClass_Primary["BoxZvalue"] = BoxZvalue
result = x_forGrid

# Assign your output to the OUT variable.
OUT = result
# ----------------------------------------

# group: Fixed Part 종류별 카운팅 및 Seed Random 값 부여
code_block_149 = CodeBlock(InputDic=extendsChildDictionaryFromParent_3.dictionary) { _InputDic; }
code_block_150 = CodeBlock { "BoxSeed"; }
code_block_151 = CodeBlock { "BoxClass_Primary"; }
valueAtKey_62 = DesignScript.Builtin.Dictionary.ValueAtKey(dictionary=code_block_149, key=code_block_151)
components_3 = DesignScript.Builtin.Dictionary.Components(dictionary=valueAtKey_62)
watch_47 = Watch(components_3.keys)
addItemToEnd_3 = List.AddItemToEnd(item=code_block_150, list=watch_47)
code_block_152 = CodeBlock { "BoxDepartment"; }
valueAtKey_63 = DesignScript.Builtin.Dictionary.ValueAtKey(dictionary=valueAtKey_62, key=code_block_152)
code_block_153 = CodeBlock()  # same code as code_block_29
contains_2 = String.Contains(str=valueAtKey_63, searchFor=code_block_153.out0@@L1)
boolean_3 = BoolSelector(true)
allIndicesOf_3 = List.AllIndicesOf(list=contains_2@@L2, item=boolean_3)
count_10 = List.Count(list=allIndicesOf_3@L3)
code_block_154 = CodeBlock { 0; }
code_block_155 = CodeBlock { "GridPointOfBldgBoundary"; }
valueAtKey_64 = DesignScript.Builtin.Dictionary.ValueAtKey(dictionary=code_block_149, key=code_block_155)
count_11 = List.Count(list=valueAtKey_64)
watch_48 = Watch(count_11)
code_block_156 = CodeBlock { "FixedPartSeed"; }
valueAtKey_65 = DesignScript.Builtin.Dictionary.ValueAtKey(dictionary=code_block_149, key=code_block_156)
randomList_4 = Math.RandomList(amount=count_10, value1=code_block_154, value2=watch_48, seed=valueAtKey_65)
count_12 = List.Count(list=allIndicesOf_3@L2)
ofRepeatedItem_2 = List.OfRepeatedItem(item=randomList_4@L1, amount=count_12@L1)
flatten_39 = List.Flatten(list=ofRepeatedItem_2)
round_8 = Math.Round(number=flatten_39)
transpose = List.Transpose(lists=components_3.values)
flatten_40 = List.Flatten(list=allIndicesOf_3)
list_getitematindex_fixed = List.GetItemAtIndex(list=transpose, index=flatten_40)
addItemToEnd_4 = List.AddItemToEnd(item=round_8@L1, list=list_getitematindex_fixed@L2)
transpose_2 = List.Transpose(lists=addItemToEnd_4)
byKeysValues_5 = DesignScript.Builtin.Dictionary.ByKeysValues(keys=addItemToEnd_3, values=transpose_2)
code_block_157 = CodeBlock(BoxClass_fixedpart=byKeysValues_5)
# ---------- code_block_157.designscript (3 lines) ----------
{
"BoxClass_fixedpart": _BoxClass_fixedpart
};
# ----------------------------------------
extendsChildDictionaryFromParent_15 = Custom[ExtendsChildDictionaryFromParent](ParentDic=code_block_149, ChildDic=code_block_157)

distributeRandomSeedForFixedPart_2 = Python(IN[0]=code_block_149, IN[1]=code_block_153.out0)  # CPython3
# ---------- distributeRandomSeedForFixedPart_2.python (91 lines) ----------
# Load the Python Standard and DesignScript Libraries
import sys
import clr
clr.AddReference('ProtoGeometry')
from Autodesk.DesignScript.Geometry import *
import random

# The inputs to this node will be stored as a list in the IN variables.
dataEnteringNode = IN
inputDic = IN[0]
fixedpart_list = IN[1]
# Place your code below this line

BoxClass_Primary = inputDic["BoxClass_Primary"]
GridPointOfBldgBoundary = inputDic["GridPointOfBldgBoundary"]
FixedPartSeed = inputDic["FixedPartSeed"]
BoxDepartment = BoxClass_Primary["BoxDepartment"]

#######################################################################
def stringContains(str, searchFor):
    result = []
    if isinstance(searchFor, list):
        if isinstance(str, list):
            for x in searchFor:
                tmp = []
                for y in str:
                    tmp.append(x in y)
                result.append(tmp)
        else:
            for x in searchFor:
                result.append(x in str)
    else:
        if isinstance(str, list):
            result = list(map(lambda x: searchFor in x, str))
        else:
            result = searchFor in str
    return result

def allIndicesOf(inlist, item):
    result = []
    if isinstance(item, list):
        if isinstance(inlist, list):
            for x in item:
                tmp = [i for i in range(len(inlist)) if inlist[i] == x]
                result.append(tmp)
        else:
            for x in item:
                tmp = [i for i in range(len(inlist)) if inlist[i] == x]
                result.append(tmp)
    else:
        if isinstance(inlist, list):
            for x in inlist:
                if isinstance(x, list):
                    tmp = [i for i in range(len(x)) if x[i] == item]
                    result.append(tmp)
                else:
                    result = [i for i in range(len(inlist)) if inlist[i] == item]
        else:
            result.append(0)
    return result

def lenOfsublist(inlist):
    result = []
    if isinstance(inlist, list):
        for subelem in inlist:
            if isinstance(subelem, list):
                #tmp.append(len(subelem))
                result.append(len(subelem))
            else:
                result = len(inlist)   
    else:
        result.append("input is not list")
    return result
    

blnlist_fixedpart = stringContains(BoxDepartment, fixedpart_list)
fixedpartIdx = allIndicesOf(blnlist_fixedpart, True)
random.seed(FixedPartSeed)
targetRange = range(0, len(GridPointOfBldgBoundary)+1)
s = random.sample(targetRange, len(fixedpartIdx))
t = lenOfsublist(fixedpartIdx)
result = t
#result = stringContains("aacd", "bb")

#######################################################################

#BoxClass_Primary["BoxZvalue"] = BoxZvalue
#result = GridPointOfBldgBoundary

# Assign your output to the OUT variable.
OUT = result
# ----------------------------------------
python_script_2 = Python()  # CPython3; unwired: IN[0]
# ---------- python_script_2.python (19 lines) ----------
# Load the Python Standard and DesignScript Libraries
import sys
import clr
clr.AddReference('ProtoGeometry')
from Autodesk.DesignScript.Geometry import *

# The inputs to this node will be stored as a list in the IN variables.
dataEnteringNode = IN

# Place your code below this line
def add_mk(a,b):
    return a + b

def multiply_mk(a,b):
    return a * b

result = [add_mk, multiply_mk]	
# Assign your output to the OUT variable.
OUT = result
# ----------------------------------------
python_script_3 = Python(IN[0]=python_script_2)  # CPython3
# ---------- python_script_3.python (18 lines) ----------
# Load the Python Standard and DesignScript Libraries
import sys
import clr
clr.AddReference('ProtoGeometry')
from Autodesk.DesignScript.Geometry import *

# The inputs to this node will be stored as a list in the IN variables.
dataEnteringNode = IN
add = IN[0][0]
multi = IN[0][1]
# Place your code below this line

#result = list(map(func1, [1,2,3]))
result = [add(3,7), multi(3,7)]


# Assign your output to the OUT variable.
OUT = result
# ----------------------------------------
