# Dynamo graph 2-3_Room with Param Generating(1008).dyn "2-3_Room with Param Generating(0702)" (Dynamo 2.10.1.3976)

categories = Categories("OST_GenericModel")
all_elements_of_category = ElementsOfCategory(Category=categories)

# group: 모든 룸 불러오기 + Level 별 추가
categories_2 = Categories("OST_Rooms")
all_elements_of_category_2 = ElementsOfCategory(Category=categories_2)
watch = Watch(all_elements_of_category_2)
flatten = List.Flatten(list=watch)
code_block = CodeBlock { "Level"; }
getParameterValueByName = Element.GetParameterValueByName(element=watch, parameterName=code_block)
watch_2 = Watch(getParameterValueByName)
levels = Levels("2nd")  # graph input
name = Level.Name(level=levels)
eq = watch_2 == name
filterByBoolMask = List.FilterByBoolMask(list=flatten, mask=eq)
watch_3 = Watch(filterByBoolMask.in)

# group: 룸 형상화 및 중점 추출
geometry = Element.Geometry(element=watch_3)
centroid = Solid.Centroid(solid=geometry)

# group: 현재 뷰에서 모든 Generic Box 불러오기 및 형상화
all_elements_in_active_view = ElementsInView()
watch_4 = Watch(all_elements_in_active_view)
name_2 = Element.Name(element=watch_4)
code_block_2 = CodeBlock { "Room"; "Space Planning Box"; }
contains = String.Contains(str=name_2, searchFor=code_block_2.out1)
filterByBoolMask_2 = List.FilterByBoolMask(list=watch_4, mask=contains)
watch_5 = Watch(filterByBoolMask_2.in)

# group: 현재 작업 레벨 분리
code_block_3 = CodeBlock { "Level"; }
getParameterValueByName_2 = Element.GetParameterValueByName(element=watch_5, parameterName=code_block_3)
string_from_object = FromObject(object=getParameterValueByName_2)
code_block_4 = CodeBlock { "2F"; }
contains_2 = String.Contains(str=string_from_object, searchFor=code_block_4)
filterByBoolMask_3 = List.FilterByBoolMask(list=watch_5, mask=contains_2)

# group: Box 중 "Corridor Box" 분리
code_block_5 = CodeBlock { "Room Name"; }
getParameterValueByName_3 = Element.GetParameterValueByName(element=filterByBoolMask_3.in, parameterName=code_block_5)
string_from_object_2 = FromObject(object=getParameterValueByName_3)
code_block_6 = CodeBlock { "Corridor"; }
contains_3 = String.Contains(str=string_from_object_2, searchFor=code_block_6)
filterByBoolMask_4 = List.FilterByBoolMask(list=filterByBoolMask_3.in, mask=contains_3)

geometry_2 = Element.Geometry(element=filterByBoolMask_4.out)

# group: Room 객체 중 Corridor 에 해당하는 객체 분리
flatten_2 = List.Flatten(list=centroid)
flatten_3 = List.Flatten(list=geometry_2)
doesIntersect = Geometry.DoesIntersect(geometry=flatten_2, other=flatten_3, lacing=CrossProduct)
allFalse = List.AllFalse(list=doesIntersect@L2)
watch_6 = Watch(allFalse)
filterByBoolMask_5 = List.FilterByBoolMask(list=watch_3, mask=watch_6)

# group: Room 중 "Corridor " 제외 객체
watch_7 = Watch(filterByBoolMask_5.out)

# group: 룸 형상화 및 중점 추출
geometry_3 = Element.Geometry(element=watch_7)
centroid_2 = Solid.Centroid(solid=geometry_3)
flatten_4 = List.Flatten(list=centroid_2)

code_block_7 = CodeBlock { 100; }
byARGB = Color.ByARGB(a=code_block_7, r=code_block_7)
byGeometryColor = Modifiers.GeometryColor.ByGeometryColor(geometry=geometry_3, color=byARGB)

# group: 1:1 겹침 없음
code_block_8 = CodeBlock {  }
code_block_9 = CodeBlock {  }

# group: 3개 겹침
code_block_10 = CodeBlock {  }
code_block_11 = CodeBlock {  }

# group: Box 중 "Corridor Box" 제외 객체
watch_8 = Watch(filterByBoolMask_4.out)

# group: Box 형상화
geometry_4 = Element.Geometry(element=watch_8)
flatten_5 = List.Flatten(list=geometry_4)

# group: Room, Box 겹침 구분 a>1
doesIntersect_2 = Geometry.DoesIntersect(geometry=flatten_4, other=flatten_5, lacing=CrossProduct)
watch_9 = Watch(doesIntersect_2)
filterByBoolMask_6 = List.FilterByBoolMask(list=watch_8, mask=watch_9@L2)
watch_10 = Watch(filterByBoolMask_6.in)
count = List.Count(list=watch_10@L2)
watch_11 = Watch(count)
code_block_12 = CodeBlock(a=watch_11) { a>1; }
watch_12 = Watch(code_block_12)
filterByBoolMask_7 = List.FilterByBoolMask(list=filterByBoolMask_6.in, mask=watch_12)

watch_13 = Watch(filterByBoolMask_7.in)
watch_14 = Watch(watch_13)
flatten_6 = List.Flatten(list=watch_14)
uniqueItems = List.UniqueItems(list=flatten_6)

# group: 2개 겹침
code_block_13 = CodeBlock {  }
code_block_14 = CodeBlock {  }

watch_15 = Watch(watch_7)
watch_16 = Watch(watch_15)
count_2 = List.Count(list=watch_14@L2)
code_block_15 = CodeBlock { 3; }
eq_2 = count_2 == code_block_15
filterByBoolMask_8 = List.FilterByBoolMask(list=watch_14, mask=eq_2)
watch_17 = Watch(filterByBoolMask_8.in)
flatten_7 = List.Flatten(list=watch_17)
code_block_16 = CodeBlock { "Area"; }
getParameterValueByName_4 = Element.GetParameterValueByName(parameterName=code_block_16)  # unwired: element
maximumItemByKey = List.MaximumItemByKey(list=flatten_7, keyFunction=getParameterValueByName_4)
geometry_5 = Element.Geometry(element=maximumItemByKey)
watch_18 = Watch(flatten_4)
watch_19 = Watch(watch_18)
doesIntersect_3 = Geometry.DoesIntersect(geometry=geometry_5, other=watch_19, lacing=Longest)
filterByBoolMask_9 = List.FilterByBoolMask(list=watch_16, mask=doesIntersect_3)
watch_20 = Watch(filterByBoolMask_9.in)
code_block_17 = CodeBlock { "Area"; }
getParameterValueByName_5 = Element.GetParameterValueByName(parameterName=code_block_17)  # unwired: element
sortByKey = List.SortByKey(list=watch_20@L1, keys=getParameterValueByName_5)
flatten_8 = List.Flatten(list=sortByKey.sortedList)
watch_21 = Watch(flatten_8)
watch_22 = Watch(filterByBoolMask_7.out)
watch_23 = Watch(watch_22)
geometry_6 = Element.Geometry(element=watch_23)
flatten_9 = List.Flatten(list=geometry_6)
geometry_7 = Element.Geometry(element=watch_15)
centroid_3 = Solid.Centroid(solid=geometry_7)
flatten_10 = List.Flatten(list=centroid_3)
doesIntersect_4 = Geometry.DoesIntersect(geometry=flatten_9, other=flatten_10, lacing=CrossProduct)
filterByBoolMask_10 = List.FilterByBoolMask(list=watch_15, mask=doesIntersect_4@L2)
watch_24 = Watch(filterByBoolMask_10.in)
count_3 = List.Count(list=watch_24@L2)
watch_25 = Watch(count_3)
code_block_18 = CodeBlock(a=watch_25) { a==2; }
watch_26 = Watch(code_block_18)
filterByBoolMask_11 = List.FilterByBoolMask(list=watch_24, mask=watch_26)
watch_27 = Watch(filterByBoolMask_11.in)
flatten_11 = List.Flatten(list=watch_27)
watch_28 = Watch(flatten_11)
area = Room.Area()  # unwired: room
maximumItemByKey_2 = List.MaximumItemByKey(list=watch_24@L2, keyFunction=area)
watch_29 = Watch(maximumItemByKey_2)

# group: Room 중 "Corridor "
watch_30 = Watch(filterByBoolMask_5.in)

# group: Room 중 "Corridor "
watch_31 = Watch(watch_30)

join = List.Join(list0=watch_21, list1=watch_28, list2=watch_29, list3=watch_31)
watch_32 = Watch(join)
code_block_19 = CodeBlock { "Name"; "Department"; "Interior Finish"; "Exterior Finish"; }
join_2 = List.Join(list0=code_block_19.out0, list1=code_block_19.out1, list2=code_block_19.out2, list3=code_block_19.out3)
code_block_20 = CodeBlock { "Area"; }
getParameterValueByName_6 = Element.GetParameterValueByName(parameterName=code_block_20)  # unwired: element
sortByKey_2 = List.SortByKey(list=flatten_7@L1, keys=getParameterValueByName_6)
flatten_12 = List.Flatten(list=sortByKey_2.sortedList)
watch_33 = Watch(flatten_12)
watch_34 = Watch(watch_13)
flatten_13 = List.Flatten(list=watch_34)
geometry_8 = Element.Geometry(element=watch_27)
centroid_4 = Solid.Centroid(solid=geometry_8)
flatten_14 = List.Flatten(list=centroid_4)
geometry_9 = Element.Geometry(element=flatten_13)
flatten_15 = List.Flatten(list=geometry_9)
doesIntersect_5 = Geometry.DoesIntersect(geometry=flatten_14, other=flatten_15, lacing=CrossProduct)
watch_35 = Watch(doesIntersect_5)
filterByBoolMask_12 = List.FilterByBoolMask(list=flatten_13, mask=watch_35@L2)
watch_36 = Watch(filterByBoolMask_12.in)
code_block_21 = CodeBlock { "Area"; }
getParameterValueByName_7 = Element.GetParameterValueByName(parameterName=code_block_21)  # unwired: element
minimumItemByKey = List.MinimumItemByKey(list=watch_36@L2, keyFunction=getParameterValueByName_7)
watch_37 = Watch(minimumItemByKey)
flatten_16 = List.Flatten(list=watch_23)
watch_38 = Watch(flatten_16)

# group: Box 중 "Corridor Box"
watch_39 = Watch(filterByBoolMask_4.in)

# group: Box 중 "Corridor Box"
watch_40 = Watch(watch_39)

join_3 = List.Join(list0=watch_33, list1=watch_37, list2=watch_38, list3=watch_40)
watch_41 = Watch(join_3)
code_block_22 = CodeBlock { "Room Name"; "Department"; "Interior Finish"; "Exterior Finish"; }
join_4 = List.Join(list0=code_block_22.out0, list1=code_block_22.out1, list2=code_block_22.out2, list3=code_block_22.out3)
getParameterValueByName_8 = Element.GetParameterValueByName(element=watch_41, parameterName=join_4, lacing=CrossProduct)
watch_42 = Watch(getParameterValueByName_8)
transpose = List.Transpose(lists=watch_42)
watch_43 = Watch(transpose)
setParameterByName = Element.SetParameterByName(element=watch_32@L2, parameterName=join_2@L1, value=watch_43@L2, lacing=Longest)

# group: BoX Room 분리, 정리 구간
code_block_23 = CodeBlock {  }
code_block_24 = CodeBlock {  }

# group: BoX Room 분리, 정리 구간
code_block_25 = CodeBlock {  }
code_block_26 = CodeBlock {  }

# group: BoX Room 정리
code_block_27 = CodeBlock {  }
code_block_28 = CodeBlock {  }

# group: 매개변수 Parameter 입력 구간 //// 요소가 겹치지만 모아서 진행 //
code_block_29 = CodeBlock {  }
code_block_30 = CodeBlock {  }

# group: BoX Room 정리
code_block_31 = CodeBlock {  }
code_block_32 = CodeBlock {  }

# group: Node 줄일 예정
code_block_33 = CodeBlock {  }
code_block_34 = CodeBlock {  }

# group: Room 중 Corridor 해당 객체 정보입력
code_block_35 = CodeBlock()
# ---------- code_block_35.designscript (6 lines) ----------
[
"Name",
"Interior Finish",
"Exterior Finish",
"Department"
];
# ----------------------------------------
code_block_36 = CodeBlock { "Room Name"; }
getParameterValueByName_9 = Element.GetParameterValueByName(element=flatten_12, parameterName=code_block_36)
code_block_37 = CodeBlock { "Interior Finish"; }
getParameterValueByName_10 = Element.GetParameterValueByName(element=flatten_12, parameterName=code_block_37)
code_block_38 = CodeBlock { "Exterior Finish"; }
getParameterValueByName_11 = Element.GetParameterValueByName(element=flatten_12, parameterName=code_block_38)
code_block_39 = CodeBlock { "Department"; }
getParameterValueByName_12 = Element.GetParameterValueByName(element=flatten_12, parameterName=code_block_39)
list_create = List.Create(item0=getParameterValueByName_9, item1=getParameterValueByName_10, item2=getParameterValueByName_11, item3=getParameterValueByName_12)
transpose_2 = List.Transpose(lists=list_create)
multi_SetParameterByName = Python(IN[0]=flatten_8, IN[1]=code_block_35, IN[2]=transpose_2)  # IronPython2; frozen
# ---------- multi_SetParameterByName.python (44 lines) ----------
# Enable Python support and load DesignScript library
import clr
clr.AddReference('ProtoGeometry')
clr.AddReference('RevitNodes')
from Autodesk.DesignScript.Geometry import *

import Revit
clr.ImportExtensions(Revit.Elements)

class DepthError(Exception):
    def __str__(self):
        return "Depth of IN[2] must be modified!"

# Count List Depth
def depthCount(x):
    return 1 + max(map(depthCount, x)) if x and isinstance(x, list) else 0

#Synchronize List Depth for 'for' statement
if isinstance(IN[0], list):
 elems = IN[0]
else:
 elems = [IN[0]]

if isinstance(IN[1], list):
 paramNames = IN[1]
else:
 paramNames = [IN[1]]

if not isinstance(IN[2], list):
 values = [[IN[2]]]
elif depthCount(IN[2]) == 1:
 values = [IN[2]]
elif depthCount(IN[2]) == 2:
 values = IN[2]
else:
 raise DepthError
 

#Set paramteter values
for e, value in zip(elems,values):
 for p, v in zip(paramNames,value):
  e.SetParameterByName(p,v)
  
OUT = elems
# ----------------------------------------
