# Dynamo graph 04 Str Foundation_mk(220111).dyn (Dynamo 2.12.0.5650)

# note: 되메우기기

# group: Primary Input : Excel & Revit Elements
categories = Categories("OST_StructuralFoundation")
all_elements_of_category = ElementsOfCategory(Category=categories)
string_from_web = Python()  # CPython3; unwired: IN[0]
# ---------- string_from_web.python (19 lines) ----------
# Load the Python Standard and DesignScript Libraries
import sys
import clr
clr.AddReference('ProtoGeometry')
from Autodesk.DesignScript.Geometry import *
import urllib.request

# The inputs to this node will be stored as a list in the IN variables.
dataEnteringNode = IN
inputURL = "https://raw.githubusercontent.com/HNANmal/mQ/master/Hdynlib/General/ImportExcel.py"

# Place your code below this line
req = urllib.request
data = req.urlopen(inputURL)

result = data.read().decode("utf-8")

# Assign your output to the OUT variable.
OUT = result
# ----------------------------------------
file_path = Filename("상상진화\20220110\DMS(Data Matching Schedule)_R0(Seq2)_220110.xlsx")  # graph input
sheet_name = CodeBlock { "Str Foundations"; }
github_python_import_excel_by = PythonStringNode(script=string_from_web, IN[0]=file_path, IN[1]=sheet_name)  # "Github_Python@Import Excel(By OpenpyXl)"; CPython3

code_block = CodeBlock { 15; }
removeItemAtIndex = List.RemoveItemAtIndex(list=all_elements_of_category, indices=code_block)

# group (continued): Primary Input : Excel & Revit Elements
code_block_2 = CodeBlock(InputElement=removeItemAtIndex, InputData=github_python_import_excel_by) { _InputElement; _InputData; }

# group: GetFull WMCodeDescription PerElement
excelDataManagerNode = Python(IN[0]=code_block_2._InputElement, IN[1]=code_block_2._InputData)  # CPython3
# ---------- excelDataManagerNode.python (279 lines) ----------
# Load the Python Standard and DesignScript Libraries
import os
import sys
sys.path.append(os.getenv('LOCALAPPDATA').replace('\\','\\\\') + r'\Programs\Python\Python39\Lib\site-packages')
import clr
clr.AddReference('RevitAPI')
import Autodesk

clr.AddReference('ProtoGeometry')
from Autodesk.DesignScript.Geometry import *

clr.AddReference('RevitNodes')
import Revit
clr.ImportExtensions(Revit.Elements)

clr.ImportExtensions(Revit.GeometryConversion)
clr.ImportExtensions(Revit.GeometryReferences)

clr.AddReference('RevitServices')
import RevitServices
from RevitServices.Persistence import DocumentManager
from RevitServices.Transactions import TransactionManager

doc = DocumentManager.Instance.CurrentDBDocument

import random
import itertools
from functools import reduce
from collections import Iterable
import datetime
import openpyxl

def iterable(obj):
    return isinstance(obj, Iterable)

def findUnique(inputs):
    result = []
    for i in inputs:
        if i in result:
            pass
        else:
            result.append(i)
    return result

# The inputs to this node will be stored as a list in the IN variables.
dataEnteringNode = IN
inputElements = IN[0]
inputData = IN[1]
#inputSheetName = IN[2]

def importExcel(path, SheetNameIn):
    wb_obj = openpyxl.load_workbook(str(path), data_only=True)
    sheet_obj = wb_obj.get_sheet_by_name(str(SheetNameIn))

    m_row = sheet_obj.max_row
    m_col = sheet_obj.max_column

    listOut = []

    for i in range(1, m_row +1):
        listTemp = []
        for j in range(1, m_col + 1):
            cell_obj = sheet_obj.cell(row=i, column=j)
            listTemp.append(cell_obj.value)
            if len(listTemp) == m_col:
                listOut.append(listTemp)
    return listOut

def getUsedFamilyTypeOfModeling(elements):
    familyCode = list(map(lambda x: x.Name.split('_')[0], elements))
    unq_familyCode = findUnique(familyCode)
    return unq_familyCode
    
def createExcelDataDictionary(values):
    result = {}
    for i in range(len(values)):
        result[str(i)] = values[i]
    return result

def findTargetIndex(targets, list):
    result = []
    for target in targets:
        for i in range(len(list)):
            if target in str(list[i]):
                result.append(i)
            else:
                pass
    result.sort()
    return result
    
def GetValueAtKeys(keys, dictionary):
    result = [] 
    for i in keys:
        result.append(dictionary[str(i)])
    return result


# Place your code below this line
usedFamilyTypeOfModeling = getUsedFamilyTypeOfModeling(inputElements)
excelWholeDataSet = inputData#importExcel(inputFilePath, inputSheetName)
trExcelWholeDataSet = list(zip(*excelWholeDataSet))
excelColumnDataSet = createExcelDataDictionary(trExcelWholeDataSet)
excelRowDataSet = createExcelDataDictionary(excelWholeDataSet)
ColumnIndexOfUsedFamilyType = findTargetIndex(usedFamilyTypeOfModeling, trExcelWholeDataSet)
ColDataSetOfUsedFamilyType = GetValueAtKeys(ColumnIndexOfUsedFamilyType, excelColumnDataSet)
materialPerElementFromModeling = []
for i in inputElements:
    materialPerElementFromModeling.append(i.GetMaterials())
#list(map(lambda x: x.GetMaterials, inputElements)) "맵함수로 처리하면 리스트화 할 때 타입 변환 오류 남"

targetWMRowIndex = []
for i in ColDataSetOfUsedFamilyType:
    targetWMRowIndex.append(findTargetIndex(['000'], i))

rowDataSetOfUsedWM = []
for i in targetWMRowIndex:
    rowDataSetOfUsedWM.append(GetValueAtKeys(i, excelRowDataSet))

workGroup = []
for i in rowDataSetOfUsedWM:
    tmp = []
    for j in i:
        tmp.append(j[0])
    workGroup.append(tmp)
    
workMaster = []
for i in range(len(ColDataSetOfUsedFamilyType)):
    tmp=[]
    for k in targetWMRowIndex[i]:
        tmp.append(ColDataSetOfUsedFamilyType[i][k])
    workMaster.append(tmp)

matchedWM = []
for i in range(len(workGroup)):
    tmp = []
    for j in range(len(workGroup[i])):
        fullWM = workGroup[i][j] +"-"+ workMaster[i][j]
        tmp.append(fullWM)
    matchedWM.append(tmp)

matchedWorkGruopAndMasterCode = []
for i in matchedWM:
    if len(i) > 0:
        matchedWorkGruopAndMasterCode.append(i)
    else:
        pass

matchedWMDescription = []
for i in rowDataSetOfUsedWM:
    tmp=[]
    for j in i:
        tmp.append(j[1] +" "+ j[2] +" "+ j[3] +" "+ "("+ j[4] +")")
    if len(tmp) > 0:
        matchedWMDescription.append(tmp)
    else:
        pass

matchedWMUnit = []
for i in rowDataSetOfUsedWM:
    tmp=[]
    for j in i:
        tmp.append(j[4])
    if len(tmp) > 0:
        matchedWMUnit.append(tmp)
    else:
        pass

matchedWorkGruopAndMasterCode_flat = list(itertools.chain(*matchedWorkGruopAndMasterCode))
matchedWMDescription_flat = list(itertools.chain(*matchedWMDescription))

dic_WMandDescription_Excel = {}
for i in range(len(matchedWorkGruopAndMasterCode_flat)):
    dic_WMandDescription_Excel[matchedWorkGruopAndMasterCode_flat[i]] = matchedWMDescription_flat[i]

usedFamilyTypeInExcelOrder = list(map(lambda x: x[3], ColDataSetOfUsedFamilyType))
usedFamilyCodeInExcelOrder = findUnique(list(map(lambda x: x.split('_')[0], usedFamilyTypeInExcelOrder)))

dic_FamilyCodeandWM = {}
for i in range(len(usedFamilyCodeInExcelOrder)):
    dic_FamilyCodeandWM[usedFamilyCodeInExcelOrder[i]] = matchedWorkGruopAndMasterCode[i]

workMasterCodePerElement = []
familyCodePerElem = list(map(lambda x: x.Name.split('_')[0], inputElements))
for i in familyCodePerElem:
    workMasterCodePerElement.append(dic_FamilyCodeandWM[i])

materialNamePerElem = []
for i in materialPerElementFromModeling:
    tmp = []
    for j in i:
        tmp.append(j.Name)
    materialNamePerElem.append(tmp)

WMPerElementFromModeling = []
for i in materialNamePerElem:
    tmp = []
    for j in i:
        tmp.append(j.split('_')[0])
    WMPerElementFromModeling.append(tmp)

specPerElementFromModeling = []
for i in materialNamePerElem:
    tmp = []
    for j in i:
        a = j.split('_')
        del a[0]
        b = " ".join(a)
        tmp.append(b)
    specPerElementFromModeling.append(tmp)

WMPerElementFromModeling_flat = list(itertools.chain(*WMPerElementFromModeling))
specPerElementFromModeling_flat = list(itertools.chain(*specPerElementFromModeling))

dic_WMandDescription_Model = {}
for i in range(len(WMPerElementFromModeling_flat)):
    dic_WMandDescription_Model[WMPerElementFromModeling_flat[i]] = specPerElementFromModeling_flat[i]

def findAllKeys(dict):
    result = []
    for key in dict.keys():
        result.append(key)
    return result

def findAllValues(dict):
    result = []
    for key in dict.keys():
        result.append(dict[key])
    return result

keys_WMandDescription_Model = findAllKeys(dic_WMandDescription_Model)
keys_WMandDescription_Excel = findAllKeys(dic_WMandDescription_Excel)

keys_WMandDescription_Both = list(set(keys_WMandDescription_Model + keys_WMandDescription_Excel))
values_WMandDescription_Both = []
for i in keys_WMandDescription_Both:
    if i in keys_WMandDescription_Model:
        values_WMandDescription_Both.append(dic_WMandDescription_Model[i])
    else:
        values_WMandDescription_Both.append(dic_WMandDescription_Excel[i])

dic_WMandDescription_Both = {}
for i in range(len(keys_WMandDescription_Both)):
    dic_WMandDescription_Both[keys_WMandDescription_Both[i]] = values_WMandDescription_Both[i]

workMasterCodePerElementFromBoth = []
for i in range(len(workMasterCodePerElement)):
    #tmp = []
    a = WMPerElementFromModeling[i] + workMasterCodePerElement[i]
    b = findUnique(a)
    workMasterCodePerElementFromBoth.append(b)

specPerElement = []
for i in workMasterCodePerElementFromBoth:
    tmp = []
    for j in i:
        tmp.append(dic_WMandDescription_Both[j])
    specPerElement.append(tmp)

fullWMCodeDescriptionPerElement = []
for i in range(len(workMasterCodePerElementFromBoth)):
    tmp = []
    for j in range(len(workMasterCodePerElementFromBoth[i])):
        a = workMasterCodePerElementFromBoth[i][j] +": "+ specPerElement[i][j]
        tmp.append(a)
    fullWMCodeDescriptionPerElement.append(tmp)

fullWMinfo = {
"AllElement": inputElements,
"WorkMasterCodePerFamilyType": dic_FamilyCodeandWM,
"WorkMasterCodePerElementBoth": workMasterCodePerElementFromBoth,
"FullWMCodeDescriptionPerElement": fullWMCodeDescriptionPerElement
}



result = fullWMinfo

# Assign your output to the OUT variable.
OUT = result
# ----------------------------------------

# group: Organize AllElementInform AsDictionary
set_up_all_element_inform_as = Python(IN[0]=excelDataManagerNode)  # "Set Up All Element Inform as Dictionary"; CPython3
# ---------- set_up_all_element_inform_as.python (119 lines) ----------
# Load the Python Standard and DesignScript Libraries
import os
import sys
sys.path.append(os.getenv('LOCALAPPDATA').replace('\\','\\\\') + r'\Programs\Python\Python39\Lib\site-packages')
import clr
clr.AddReference('RevitAPI')
import Autodesk

clr.AddReference('ProtoGeometry')
from Autodesk.DesignScript.Geometry import *

clr.AddReference('RevitNodes')
import Revit
clr.ImportExtensions(Revit.Elements)

clr.ImportExtensions(Revit.GeometryConversion)
clr.ImportExtensions(Revit.GeometryReferences)

clr.AddReference('RevitServices')
import RevitServices
from RevitServices.Persistence import DocumentManager
from RevitServices.Transactions import TransactionManager

doc = DocumentManager.Instance.CurrentDBDocument

import random
import itertools
from functools import reduce
from collections import Iterable
import datetime
import openpyxl

def iterable(obj):
    return isinstance(obj, Iterable)

def findUnique(inputs):
    result = []
    for i in inputs:
        if i in result:
            pass
        else:
            result.append(i)
    return result

# The inputs to this node will be stored as a list in the IN variables.
dataEnteringNode = IN
inputDict = IN[0]


def importExcel(path, SheetNameIn):
    wb_obj = openpyxl.load_workbook(str(path), data_only=True)
    sheet_obj = wb_obj.get_sheet_by_name(str(SheetNameIn))

    m_row = sheet_obj.max_row
    m_col = sheet_obj.max_column

    listOut = []

    for i in range(1, m_row +1):
        listTemp = []
        for j in range(1, m_col + 1):
            cell_obj = sheet_obj.cell(row=i, column=j)
            listTemp.append(cell_obj.value)
            if len(listTemp) == m_col:
                listOut.append(listTemp)
    return listOut

def getUsedFamilyTypeOfModeling(elements):
    familyCode = list(map(lambda x: x.Name.split('_')[0], elements))
    unq_familyCode = findUnique(familyCode)
    return unq_familyCode
    
def createExcelDataDictionary(values):
    result = {}
    for i in range(len(values)):
        result[str(i)] = values[i]
    return result

def findTargetIndex(targets, list):
    result = []
    for target in targets:
        for i in range(len(list)):
            if target in str(list[i]):
                result.append(i)
            else:
                pass
    result.sort()
    return result
    
def GetValueAtKeys(keys, dictionary):
    result = [] 
    for i in keys:
        result.append(dictionary[str(i)])
    return result


# Place your code below this line
element = inputDict["AllElement"]
elementType = []
for i in element:
    elementType.append(i.Name)
familyCode = []
for i in elementType:
    familyCode.append(i.split("_")[0])
fullWMCodeDescriptionPerElement = inputDict["FullWMCodeDescriptionPerElement"]

resultDict = {
"Element": element,
"ElementType": elementType,
"FamilyCode": familyCode,
"FullWMCodeDescriptionPerElement": fullWMCodeDescriptionPerElement
}



result = resultDict

# Assign your output to the OUT variable.
OUT = result
# ----------------------------------------

# group: Select Target Family Element And Connected WorkMasters
code_block_3 = CodeBlock { 0; }
select_target_family_element_and = Python(IN[0]=set_up_all_element_inform_as, IN[1]=code_block_3)  # "Select Target Family Element And Connected WorkMasters"; CPython3
# ---------- select_target_family_element_and.python (138 lines) ----------
# Load the Python Standard and DesignScript Libraries
import os
import sys
sys.path.append(os.getenv('LOCALAPPDATA').replace('\\','\\\\') + r'\Programs\Python\Python39\Lib\site-packages')
import clr
clr.AddReference('RevitAPI')
import Autodesk

clr.AddReference('ProtoGeometry')
from Autodesk.DesignScript.Geometry import *

clr.AddReference('RevitNodes')
import Revit
clr.ImportExtensions(Revit.Elements)

clr.ImportExtensions(Revit.GeometryConversion)
clr.ImportExtensions(Revit.GeometryReferences)

clr.AddReference('RevitServices')
import RevitServices
from RevitServices.Persistence import DocumentManager
from RevitServices.Transactions import TransactionManager

doc = DocumentManager.Instance.CurrentDBDocument

import random
import itertools
from functools import reduce
from collections import Iterable
import datetime
import openpyxl

def iterable(obj):
    return isinstance(obj, Iterable)

def findUnique(inputs):
    result = []
    for i in inputs:
        if i in result:
            pass
        else:
            result.append(i)
    return result

# The inputs to this node will be stored as a list in the IN variables.
dataEnteringNode = IN
inputDict = IN[0]
inputIndex = IN[1]


def importExcel(path, SheetNameIn):
    wb_obj = openpyxl.load_workbook(str(path), data_only=True)
    sheet_obj = wb_obj.get_sheet_by_name(str(SheetNameIn))

    m_row = sheet_obj.max_row
    m_col = sheet_obj.max_column

    listOut = []

    for i in range(1, m_row +1):
        listTemp = []
        for j in range(1, m_col + 1):
            cell_obj = sheet_obj.cell(row=i, column=j)
            listTemp.append(cell_obj.value)
            if len(listTemp) == m_col:
                listOut.append(listTemp)
    return listOut

def getUsedFamilyTypeOfModeling(elements):
    familyCode = list(map(lambda x: x.Name.split('_')[0], elements))
    unq_familyCode = findUnique(familyCode)
    return unq_familyCode
    
def createExcelDataDictionary(values):
    result = {}
    for i in range(len(values)):
        result[str(i)] = values[i]
    return result

def findTargetIndex(targets, list):
    result = []
    for target in targets:
        for i in range(len(list)):
            if target in str(list[i]):
                result.append(i)
            else:
                pass
    result.sort()
    return result
    
def GetValueAtKeys(keys, dictionary):
    result = [] 
    for i in keys:
        result.append(dictionary[str(i)])
    return result


# Place your code below this line
fullWMCodeDescriptionPerElement = inputDict["FullWMCodeDescriptionPerElement"]
element = inputDict["Element"]
familyCode = inputDict["FamilyCode"]
familyCode_unique = findUnique(familyCode)
targetFamilyCode = familyCode_unique[inputIndex]
targetIndex = []
for i in range(len(familyCode)):
    if targetFamilyCode in familyCode[i]:
        targetIndex.append(i)
    else:
        pass

targetElements = []
for i in targetIndex:
    targetElements.append(element[i])

targetFamilyCode = []
for i in targetIndex:
    targetFamilyCode.append(element[i].Name)

WMforTargetElements = []
for i in targetIndex:
    WMforTargetElements.append(fullWMCodeDescriptionPerElement[i])

WMforTargetElements_flat = list(itertools.chain(*WMforTargetElements))
targetWMunique = findUnique(WMforTargetElements_flat)

resultDict = {
"TargetElements": targetElements,
"TargetFamilyCode": targetFamilyCode,
"WMforTargetElements": WMforTargetElements,
"TargetWMunique": targetWMunique
}



result = resultDict

# Assign your output to the OUT variable.
OUT = result
# ----------------------------------------

code_block_4 = CodeBlock(i=select_target_family_element_and) { i; }

# group: <Func 0> Input Manager
value_for_import_from_others = CodeBlock(MainInput=code_block_4) { MainInput; RefInput; }  # unwired: RefInput

# group: <Func 0> Structural Concrete
code_block_5 = CodeBlock { "TargetElements"; }
valueAtKey = DesignScript.Builtin.Dictionary.ValueAtKey(dictionary=value_for_import_from_others.MainInput, key=code_block_5)
code_block_6 = CodeBlock { "Volume"; }
# note: <Func>
getParameterValueByName = Element.GetParameterValueByName(element=valueAtKey, parameterName=code_block_6)
code_block_7 = CodeBlock(i=getParameterValueByName) { Math.Round(List.Flatten(i)/1, 2); }
code_block_8 = CodeBlock { "M3"; }
count = List.Count(list=code_block_7)
ofRepeatedItem = List.OfRepeatedItem(item=code_block_8, amount=count)
code_block_9 = CodeBlock(FuncValues=code_block_7, FuncValuesUnit=ofRepeatedItem)
# ---------- code_block_9.designscript (4 lines) ----------
{
"FuncValues": _FuncValues,
"FuncValuesUnit": _FuncValuesUnit
};
# ----------------------------------------

# group: <Func 0> Output Manager
output = CodeBlock(MainOutput=code_block_9) { MainOutput; RefOutput1; RefOutput2; }  # unwired: RefOutput1, RefOutput2
reference_output = CodeBlock { ref; }  # unwired: ref

# group: <Func 5> Input Manager
value_for_import_from_others_2 = CodeBlock(MainInput=code_block_4) { MainInput; RefInput; }  # unwired: RefInput

# group: <Func 5> Lean Concrete
code_block_10 = CodeBlock { "TargetElements"; }
valueAtKey_2 = DesignScript.Builtin.Dictionary.ValueAtKey(dictionary=value_for_import_from_others_2.MainInput, key=code_block_10)
# note: <Func>
createLeanConcrete = Custom[CreateLeanConcrete](Element=valueAtKey_2)
flatten = List.Flatten(list=createLeanConcrete.Solid)
value_for_export_to_others = CodeBlock(린콘크리트형상=flatten) { 린콘크리트형상; }
volume = Solid.Volume(solid=createLeanConcrete.Solid)
code_block_11 = CodeBlock(i=volume) { Math.Round(List.Flatten(i)/1000000000, 2); }
code_block_12 = CodeBlock { "M3"; }
count_2 = List.Count(list=code_block_11)
ofRepeatedItem_2 = List.OfRepeatedItem(item=code_block_12, amount=count_2)
code_block_13 = CodeBlock(FuncValues=code_block_11, FuncValuesUnit=ofRepeatedItem_2)  # same code as code_block_9

# group: <Func 5> Output Manager
reference_output_2 = CodeBlock(ref=value_for_export_to_others) { ref; }
output_2 = CodeBlock(MainOutput=code_block_13, RefOutput_geoColor=createLeanConcrete.GeometryColor) { MainOutput; RefOutput_geoColor; }

# group: <Func 1> Input Manager
value_for_import_from_others_3 = CodeBlock(MainInput=code_block_4, RefInput=reference_output_2) { MainInput; RefInput; }

# group: <Func 1-1> Excavation by IsoFDN
하부_surface_추출 = Python(IN[0]=value_for_import_from_others_3.RefInput)  # CPython3
# ---------- 하부_surface_추출.python (26 lines) ----------
# Load the Python Standard and DesignScript Libraries
import sys
import clr
import itertools
clr.AddReference('ProtoGeometry')
from Autodesk.DesignScript.Geometry import *

# The inputs to this node will be stored as a list in the IN variables.
dataEnteringNode = IN
input_elements = IN[0]

# Place your code below this line

srfs_input_elements = list(map(lambda x: x.Explode(), input_elements))

#srfs_input_flatten = list(itertools.chain(*srfs_input_elements))

def func_findZ_normalAtParma(srf):
    return srf.NormalAtParameter(0.5,0.5).Z
srfs_below = list(map(lambda y: filter(lambda x: func_findZ_normalAtParma(x) == -1, y), srfs_input_elements))

result = srfs_below


# Assign your output to the OUT variable.
OUT = result
# ----------------------------------------
flatten_2 = List.Flatten(list=하부_surface_추출)
perimeterCurves = Surface.PerimeterCurves(surface=flatten_2)
byJoinedCurves = PolyCurve.ByJoinedCurves(curves=perimeterCurves)
code_block_14 = CodeBlock { _ExcavOffsetBottom: var[]..[] = 300; }
offset = Curve.Offset(curve=byJoinedCurves, distance=code_block_14)
flatten_3 = List.Flatten(list=offset)
levels = Levels("G.L")  # graph input
elevation = Level.Elevation(level=levels)
code_block_15 = CodeBlock { "TargetElements"; }
valueAtKey_3 = DesignScript.Builtin.Dictionary.ValueAtKey(dictionary=value_for_import_from_others_3.MainInput, key=code_block_15)
code_block_16 = CodeBlock { "Elevation at Bottom"; }
getParameterValueByName_2 = Element.GetParameterValueByName(element=valueAtKey_3, parameterName=code_block_16)
린_콘크리트_하부까지의_길이_추출_최하단 = Python(IN[0]=value_for_import_from_others_3.RefInput)  # CPython3
# ---------- 린_콘크리트_하부까지의_길이_추출_최하단.python (22 lines) ----------
# Load the Python Standard and DesignScript Libraries
import sys
import clr
clr.AddReference('ProtoGeometry')
from Autodesk.DesignScript.Geometry import *

# The inputs to this node will be stored as a list in the IN variables.
dataEnteringNode = IN
inputs = IN[0]

# Place your code below this line

def findThickness(i):
    minPt_Z = BoundingBox.ByGeometry(i).MinPoint.Z
    maxPt_Z = BoundingBox.ByGeometry(i).MaxPoint.Z
    result = maxPt_Z - minPt_Z
    return result

thicknessByInput = list(map(findThickness, inputs))

# Assign your output to the OUT variable.
OUT = thicknessByInput
# ----------------------------------------
code_block_17 = CodeBlock(기초하단=getParameterValueByName_2, 린콘크리트하단=린_콘크리트_하부까지의_길이_추출_최하단) { 기초하단-린콘크리트하단; }
sub = elevation - code_block_17
code_block_18 = CodeBlock { 0; }
isNull = Object.IsNull()  # unwired: object
replaceByCondition = Replace(item=sub, replaceWith=code_block_18, condition=isNull)
flatten_4 = List.Flatten(list=replaceByCondition)
translate = Geometry.Translate(geometry=offset, zTranslation=flatten_4)
경사_비율_입력_1_x_for_isofdn = DoubleInput(2)  # graph input
code_block_19 = CodeBlock(ElevationatBottom=flatten_4, 비율=경사_비율_입력_1_x_for_isofdn) { ElevationatBottom/비율; }
offset_2 = Curve.Offset(curve=translate, distance=code_block_19)
flatten_5 = List.Flatten(list=offset_2)
list_create = List.Create(item0=flatten_3, item1=flatten_5)
transpose = List.Transpose(lists=list_create)
byLoft = Solid.ByLoft(crossSections=transpose)
터파기_형상_겹침_해소 = Python(IN[0]=byLoft)  # CPython3
# ---------- 터파기_형상_겹침_해소.python (31 lines) ----------
# Load the Python Standard and DesignScript Libraries
import sys
import clr
clr.AddReference('ProtoGeometry')
from Autodesk.DesignScript.Geometry import *

# The inputs to this node will be stored as a list in the IN variables.
dataEnteringNode = IN
inputs = IN[0]

# Place your code below this line

def solveOverlap(inputs):
    result = []
    for x in range(len(inputs)):
        if x < len(inputs)-1:
            temp = []
            apply = inputs[x]
            for y in range(x,len(inputs)):
                if apply.DoesIntersect(inputs[y]):
                    apply = apply.Split(inputs[y])[0]
                    temp.append(apply)
                else:
                    apply = apply
                    temp.append(apply)
            result.append(temp[-1])
        elif x == len(inputs)-1:
            result.append(inputs[x])

# Assign your output to the OUT variable.
OUT = solveOverlap(inputs)
# ----------------------------------------
volume_2 = Solid.Volume(solid=터파기_형상_겹침_해소)
code_block_20 = CodeBlock(i=volume_2) { Math.Round(List.Flatten(i)/1000000000, 2); }
code_block_21 = CodeBlock { "M3"; }
count_3 = List.Count(list=code_block_20)
ofRepeatedItem_3 = List.OfRepeatedItem(item=code_block_21, amount=count_3)
code_block_22 = CodeBlock(FuncValues=code_block_20, FuncValuesUnit=ofRepeatedItem_3)  # same code as code_block_9
color_palette = ColorPalette({R: 210, G: 105, B: 30, A: 135})
byGeometryColor = Modifiers.GeometryColor.ByGeometryColor(geometry=터파기_형상_겹침_해소, color=color_palette)
forRefOutput = CodeBlock(MainOutput=code_block_22, geoColor=byGeometryColor, 터파기형상=터파기_형상_겹침_해소)
# ---------- forRefOutput.designscript (5 lines) ----------
{
"MainOutput": MainOutput,
"geoColor": geoColor,
"터파기형상": 터파기형상
};
# ----------------------------------------

# group: <Func 1-2> Excavation by Overall
하부_surface_추출_2 = Python(IN[0]=value_for_import_from_others_3.RefInput)  # CPython3; same code as 하부_surface_추출
flatten_6 = List.Flatten(list=하부_surface_추출_2)
byGeometry = BoundingBox.ByGeometry(geom=flatten_6)
toCuboid = BoundingBox.ToCuboid(boundingBox=byGeometry)
code_block_23 = CodeBlock(i=toCuboid) { [i]; }
하부_surface_추출_3 = Python(IN[0]=code_block_23)  # CPython3; same code as 하부_surface_추출
perimeterCurves_2 = Surface.PerimeterCurves(surface=하부_surface_추출_3)
byJoinedCurves_2 = PolyCurve.ByJoinedCurves(curves=perimeterCurves_2)
code_block_24 = CodeBlock { _ExcavOffsetBottom: var[]..[] = 300; }
offset_3 = Curve.Offset(curve=byJoinedCurves_2, distance=code_block_24)
flatten_7 = List.Flatten(list=offset_3)
levels_2 = Levels("G.L")  # graph input
elevation_2 = Level.Elevation(level=levels_2)
code_block_25 = CodeBlock { "TargetElements"; }
valueAtKey_4 = DesignScript.Builtin.Dictionary.ValueAtKey(dictionary=value_for_import_from_others_3.MainInput, key=code_block_25)
code_block_26 = CodeBlock { "Elevation at Bottom"; }
getParameterValueByName_3 = Element.GetParameterValueByName(element=valueAtKey_4, parameterName=code_block_26)
린_콘크리트_하부까지의_길이_추출_최하단_2 = Python(IN[0]=value_for_import_from_others_3.RefInput)  # CPython3; same code as 린_콘크리트_하부까지의_길이_추출_최하단
code_block_27 = CodeBlock(기초하단=getParameterValueByName_3, 린콘크리트하단=린_콘크리트_하부까지의_길이_추출_최하단_2) { 기초하단-린콘크리트하단; }
uniqueItems = List.UniqueItems(list=code_block_27@L2)
sub_2 = elevation_2 - uniqueItems
code_block_28 = CodeBlock { 0; }
isNull_2 = Object.IsNull()  # unwired: object
replaceByCondition_2 = Replace(item=sub_2, replaceWith=code_block_28, condition=isNull_2)
flatten_8 = List.Flatten(list=replaceByCondition_2)
translate_2 = Geometry.Translate(geometry=offset_3, zTranslation=flatten_8)
경사_비율_입력_1_x_for_overall = DoubleInput(2)  # graph input
code_block_29 = CodeBlock(ElevationatBottom=flatten_8, 비율=경사_비율_입력_1_x_for_overall) { ElevationatBottom/비율; }
offset_4 = Curve.Offset(curve=translate_2, distance=code_block_29)
flatten_9 = List.Flatten(list=offset_4)
list_create_2 = List.Create(item0=flatten_7, item1=flatten_9)
transpose_2 = List.Transpose(lists=list_create_2)
byLoft_2 = Solid.ByLoft(crossSections=transpose_2)
터파기_형상_겹침_해소_2 = Python(IN[0]=byLoft_2)  # CPython3
# ---------- 터파기_형상_겹침_해소_2.python (29 lines) ----------
# Load the Python Standard and DesignScript Libraries
import sys
import clr
clr.AddReference('ProtoGeometry')
from Autodesk.DesignScript.Geometry import *

# The inputs to this node will be stored as a list in the IN variables.
dataEnteringNode = IN
inputs = IN[0]
result = []
# Place your code below this line

for x in range(len(inputs)):
    if x < len(inputs)-1:
        temp = []
        apply = inputs[x]
        for y in range(x,len(inputs)):
            if apply.DoesIntersect(inputs[y]):
                apply = apply.Split(inputs[y])[0]
                temp.append(apply)
            else:
                apply = apply
                temp.append(apply)
        result.append(temp[-1])
    elif x == len(inputs)-1:
        result.append(inputs[x])

# Assign your output to the OUT variable.
OUT = result
# ----------------------------------------
volume_3 = Solid.Volume(solid=터파기_형상_겹침_해소_2)
code_block_30 = CodeBlock(i=volume_3) { Math.Round(List.Flatten(i)/1000000000, 2); }
code_block_31 = CodeBlock { "M3"; }
count_4 = List.Count(list=code_block_30)
ofRepeatedItem_4 = List.OfRepeatedItem(item=code_block_31, amount=count_4)
code_block_32 = CodeBlock(FuncValues=code_block_30, FuncValuesUnit=ofRepeatedItem_4)  # same code as code_block_9
color_palette_2 = ColorPalette({R: 210, G: 105, B: 30, A: 135})
byGeometryColor_2 = Modifiers.GeometryColor.ByGeometryColor(geometry=터파기_형상_겹침_해소_2, color=color_palette_2)
forRefOutput_2 = CodeBlock(MainOutput=code_block_32, geoColor=byGeometryColor_2, 터파기형상=터파기_형상_겹침_해소_2)  # same code as forRefOutput

# group: 함수 선택
터파기_산출_타입_선택_iso_or_overall = StringInput("iso")  # graph input
code_block_33 = CodeBlock(functionName=터파기_산출_타입_선택_iso_or_overall) { functionName == "iso"? true:false; }
if_ = If(test=code_block_33, true=forRefOutput, false=forRefOutput_2)

# group: <Func 1> Output Manager
code_block_34 = CodeBlock { "MainOutput"; }
valueAtKey_5 = DesignScript.Builtin.Dictionary.ValueAtKey(dictionary=if_, key=code_block_34)
code_block_35 = CodeBlock { "geoColor"; }
valueAtKey_6 = DesignScript.Builtin.Dictionary.ValueAtKey(dictionary=if_, key=code_block_35)
output_3 = CodeBlock(MainOutput=valueAtKey_5, RefOutput_geoColor=valueAtKey_6) { MainOutput; RefOutput_geoColor; }
code_block_36 = CodeBlock { "터파기형상"; }
valueAtKey_7 = DesignScript.Builtin.Dictionary.ValueAtKey(dictionary=if_, key=code_block_36)
reference_output_3 = CodeBlock(터파기형상=valueAtKey_7) { 터파기형상; }

# group: <Func 2> Input Manager
value_for_import_from_others_4 = CodeBlock(MainInput=code_block_4, RefInput1=reference_output_3, RefInput2=reference_output_2) { MainInput; RefInput1; RefInput2; }

# group: <Func 2> Backfill
value_for_import_from_others_5 = CodeBlock(터파기형상=value_for_import_from_others_4.RefInput1) { 터파기형상; }
flatten_10 = List.Flatten(list=value_for_import_from_others_5)
volume_4 = Solid.Volume(solid=flatten_10)
flatten_11 = List.Flatten(list=value_for_import_from_others_4.RefInput2)
code_block_37 = CodeBlock { "TargetElements"; }
valueAtKey_8 = DesignScript.Builtin.Dictionary.ValueAtKey(dictionary=value_for_import_from_others_4.MainInput, key=code_block_37)
geometry = Element.Geometry(element=valueAtKey_8)
flatten_12 = List.Flatten(list=geometry)
categories_2 = Categories("OST_StructuralColumns")
all_elements_of_category_2 = ElementsOfCategory(Category=categories_2)
geometry_2 = Element.Geometry(element=all_elements_of_category_2)
flatten_13 = List.Flatten(list=geometry_2)
doesIntersect = Geometry.DoesIntersect(geometry=flatten_10, other=flatten_13, lacing=CrossProduct)
filterByBoolMask = List.FilterByBoolMask(list=flatten_13, mask=doesIntersect@L2)
flatten_14 = List.Flatten(list=filterByBoolMask.in)
list_create_3 = List.Create(item0=flatten_11, item1=flatten_12, item2=flatten_14)
transpose_3 = List.Transpose(lists=list_create_3)
byUnion = Solid.ByUnion(solids=transpose_3)
volume_5 = Solid.Volume(solid=byUnion)
code_block_38 = CodeBlock(터파기볼륨=volume_4, 콘크리트들볼륨=volume_5) { 터파기볼륨 - 콘크리트들볼륨; }
watch = Watch(code_block_38)
code_block_39 = CodeBlock(i=watch) { Math.Round(List.Flatten(i)/1000000000, 2); }
code_block_40 = CodeBlock { "M3"; }
count_5 = List.Count(list=watch)
ofRepeatedItem_5 = List.OfRepeatedItem(item=code_block_40, amount=count_5)
# note: 터파기 물량ㅈ에서 콘크리트, 린 기둥 물량 빼기
code_block_41 = CodeBlock(FuncValues=code_block_39, FuncValuesUnit=ofRepeatedItem_5)  # same code as code_block_9

# group: <Func 2> Output Manager
output_4 = CodeBlock(MainOutput=code_block_41) { MainOutput; RefOutput_geoColor; }  # unwired: RefOutput_geoColor
reference_output_4 = CodeBlock(콘크리트들볼륨=volume_5) { 콘크리트들볼륨; }

# group: <Func 3> Input Manager
value_for_import_from_others_6 = CodeBlock(MainInput=code_block_4, RefInput1=reference_output_4) { MainInput; RefInput1; RefInput2; }  # unwired: RefInput2

# group: <Func 3> Disposal (잔토처리 1.2 비율)
watch_2 = Watch(value_for_import_from_others_6.RefInput1)
토량_환산_계수 = DoubleInput(1)  # graph input
code_block_42 = CodeBlock(i=watch_2, 토량환산계수=토량_환산_계수) { Math.Round(List.Flatten(i)/1000000000, 2)*토량환산계수; }
code_block_43 = CodeBlock { "M3"; }
count_6 = List.Count(list=watch_2)
ofRepeatedItem_6 = List.OfRepeatedItem(item=code_block_43, amount=count_6)
# note: 잔토처리
code_block_44 = CodeBlock(FuncValues=code_block_42, FuncValuesUnit=ofRepeatedItem_6)  # same code as code_block_9

# group: <Func 3> Output Manager
output_5 = CodeBlock(MainOutput=code_block_44) { MainOutput; RefOutput_geoColor; }  # unwired: RefOutput_geoColor
reference_output_5 = CodeBlock { ref; }  # unwired: ref

# group: <Func 4> Input Manager
value_for_import_from_others_7 = CodeBlock(MainInput=code_block_4) { MainInput; RefInput1; RefInput2; }  # unwired: RefInput1, RefInput2

code_block_45 = CodeBlock { 300; 100; }

# group: <Func 4> Base Course
code_block_46 = CodeBlock { "TargetElements"; }
valueAtKey_9 = DesignScript.Builtin.Dictionary.ValueAtKey(dictionary=value_for_import_from_others_7.MainInput, key=code_block_46)
# note: <Func>
createBaseCourseSurfaces = Custom[CreateBaseCourseSurfaces](Element=valueAtKey_9, BaseCourseOffsetBottom=code_block_45.out0, leanThick=code_block_45.out1)
area = Surface.Area(surface=createBaseCourseSurfaces.Surface)
code_block_47 = CodeBlock(i=area) { Math.Round(List.Flatten(i)/1000000, 2); }
code_block_48 = CodeBlock { "M2"; }
count_7 = List.Count(list=code_block_47)
ofRepeatedItem_7 = List.OfRepeatedItem(item=code_block_48, amount=count_7)
code_block_49 = CodeBlock(FuncValues=code_block_47, FuncValuesUnit=ofRepeatedItem_7)  # same code as code_block_9

# group: <Func 4> Output Manager
output_6 = CodeBlock(MainOutput=code_block_49, RefOutput_geoColor=createBaseCourseSurfaces.GeometryColor) { MainOutput; RefOutput_geoColor; }
reference_output_6 = CodeBlock { ref; }  # unwired: ref

# group: <Func 6> Input Manager
value_for_import_from_others_8 = CodeBlock(MainInput=code_block_4) { MainInput; RefInput1; RefInput2; }  # unwired: RefInput1, RefInput2

# group: <Func 6> Form Works
code_block_50 = CodeBlock { "TargetElements"; }
valueAtKey_10 = DesignScript.Builtin.Dictionary.ValueAtKey(dictionary=value_for_import_from_others_8.MainInput, key=code_block_50)
code_block_51 = CodeBlock { "M2"; }
# note: <Func>
extractSideFacesOfElement = Custom[ExtractSideFacesOfElement](Element=valueAtKey_10)

extractSideFacesOfElement_2 = Python(IN[0]=valueAtKey_10)  # CPython3
# ---------- extractSideFacesOfElement_2.python (21 lines) ----------
# Load the Python Standard and DesignScript Libraries
import sys
import clr
clr.AddReference('ProtoGeometry')
from Autodesk.DesignScript.Geometry import *

# The inputs to this node will be stored as a list in the IN variables.
dataEnteringNode = IN
_inputs = IN[0]
# Place your code below this line
def main():
    def findSideSrf(input):
        geo = input.Geometry()[0]
        allSrf = geo.Explode()
        sideSrf = [i for i in allSrf if round(i.NormalAtParameter(0.5,0.5).Z)==0]
        
        return sideSrf
        
    return [findSideSrf(i) for i in _inputs]
# Assign your output to the OUT variable.
OUT = main()
# ----------------------------------------

# group (continued): <Func 6> Form Works
area_2 = Surface.Area(surface=extractSideFacesOfElement_2)
sum = Math.Sum(values=area_2)
code_block_52 = CodeBlock(i=sum) { Math.Round(List.Flatten(i)/1000000, 2); }
count_8 = List.Count(list=code_block_52)
ofRepeatedItem_8 = List.OfRepeatedItem(item=code_block_51, amount=count_8)
code_block_53 = CodeBlock(FuncValues=code_block_52, FuncValuesUnit=ofRepeatedItem_8)  # same code as code_block_9

# group: <Func 6> Output Manager
output_7 = CodeBlock(MainOutput=code_block_53, RefOutput_geoColor=extractSideFacesOfElement.GeometryColor) { MainOutput; RefOutput_geoColor; }
reference_output_7 = CodeBlock { ref; }  # unwired: ref

# group: <Func 7> Input Manager
value_for_import_from_others_9 = CodeBlock(MainInput=code_block_4) { MainInput; RefInput1; RefInput2; factor; }  # unwired: RefInput1, RefInput2, factor

# group: <Func 7> Rebar
code_block_54 = CodeBlock { "TargetElements"; }
valueAtKey_11 = DesignScript.Builtin.Dictionary.ValueAtKey(dictionary=value_for_import_from_others_9.MainInput, key=code_block_54)
code_block_55 = CodeBlock { "Volume"; }
# note: <Func>
getParameterValueByName_4 = Element.GetParameterValueByName(element=valueAtKey_11, parameterName=code_block_55)
독립기초_철근비 = DoubleInput(0)  # graph input
mul = getParameterValueByName_4 * 독립기초_철근비
code_block_56 = CodeBlock(i=mul) { Math.Round(List.Flatten(i)/1, 2); }
code_block_57 = CodeBlock { "TON"; }
count_9 = List.Count(list=code_block_56)
ofRepeatedItem_9 = List.OfRepeatedItem(item=code_block_57, amount=count_9)
code_block_58 = CodeBlock(FuncValues=code_block_56, FuncValuesUnit=ofRepeatedItem_9)  # same code as code_block_9

# group: <Func 7> Output Manager
output_8 = CodeBlock(MainOutput=code_block_58) { MainOutput; RefOutput_geoColor; }  # unwired: RefOutput_geoColor
reference_output_8 = CodeBlock { ref; }  # unwired: ref

# group: <Func 8> Input Manager
value_for_import_from_others_10 = CodeBlock(MainInput=code_block_4) { MainInput; RefInput1; RefInput2; }  # unwired: RefInput1, RefInput2

# group: <Func 8> Sheet Memebrane
code_block_59 = CodeBlock { "TargetElements"; }
valueAtKey_12 = DesignScript.Builtin.Dictionary.ValueAtKey(dictionary=value_for_import_from_others_10.MainInput, key=code_block_59)
# note: <Func>
createLeanConcrete_2 = Custom[CreateLeanConcrete](Element=valueAtKey_12)
area_3 = Surface.Area(surface=createLeanConcrete_2.Surface)
code_block_60 = CodeBlock(i=area_3) { Math.Round(List.Flatten(i)/1000000, 2); }
code_block_61 = CodeBlock { "M2"; }
count_10 = List.Count(list=code_block_60)
ofRepeatedItem_10 = List.OfRepeatedItem(item=code_block_61, amount=count_10)
code_block_62 = CodeBlock(FuncValues=code_block_60, FuncValuesUnit=ofRepeatedItem_10)  # same code as code_block_9

# group: <Func 8> Output Manager
output_9 = CodeBlock(MainOutput=code_block_62) { MainOutput; RefOutput_geoColor; }  # unwired: RefOutput_geoColor
reference_output_9 = CodeBlock { ref; }  # unwired: ref

# group: <Func 9> Input Manager
value_for_import_from_others_11 = CodeBlock(MainInput=code_block_4) { MainInput; RefInput1; RefInput2; }  # unwired: RefInput1, RefInput2

# group: <Func 9> Membrane Protection Board (측면 + 상부면 중 pedestal 점유면적 제외)
code_block_63 = CodeBlock { "TargetElements"; }
# note: <Func>
valueAtKey_13 = DesignScript.Builtin.Dictionary.ValueAtKey(dictionary=value_for_import_from_others_11.MainInput, key=code_block_63)
code_block_64 = CodeBlock(Element=valueAtKey_13) { _Element; }
extractUpperFacesOfElement = Custom[ExtractUpperFacesOfElement](Element=code_block_64)
flatten_15 = List.Flatten(list=extractUpperFacesOfElement.Surface)
getJoinedElements = Element.GetJoinedElements(element=code_block_64)
flatten_16 = List.Flatten(list=getJoinedElements)
extractBelowFacesOfElement = Custom[ExtractBelowFacesOfElement](Element=flatten_16)
flatten_17 = List.Flatten(list=extractBelowFacesOfElement.Surface)
doesIntersect_2 = Geometry.DoesIntersect(geometry=flatten_17, other=flatten_15, lacing=CrossProduct)
code_block_65 = CodeBlock { true; }
allIndicesOf = List.AllIndicesOf(list=doesIntersect_2@L2, item=code_block_65)
flatten_18 = List.Flatten(list=allIndicesOf)
groupByKey = List.GroupByKey(list=flatten_17, keys=flatten_18)
difference = Surface.Difference(surface=flatten_15, others=groupByKey.groups)
extractSideFacesOfElement_3 = Custom[ExtractSideFacesOfElement](Element=code_block_64)
addItemToFront = List.AddItemToFront(item=difference@L1, list=extractSideFacesOfElement_3.Surface@L2)
area_4 = Surface.Area(surface=addItemToFront)
sum_2 = Math.Sum(values=area_4)
code_block_66 = CodeBlock(i=sum_2) { Math.Round(List.Flatten(i)/1000000, 2); }
code_block_67 = CodeBlock { "M2"; }
count_11 = List.Count(list=code_block_66)
ofRepeatedItem_11 = List.OfRepeatedItem(item=code_block_67, amount=count_11)
code_block_68 = CodeBlock(FuncValues=code_block_66, FuncValuesUnit=ofRepeatedItem_11)  # same code as code_block_9
color_palette_3 = ColorPalette({R: 30, G: 144, B: 255, A: 129})
byGeometryColor_3 = Modifiers.GeometryColor.ByGeometryColor(geometry=addItemToFront, color=color_palette_3)

# group: <Func 9> Output Manager
output_10 = CodeBlock(MainOutput=code_block_68, RefOutput_geoColor=byGeometryColor_3) { MainOutput; RefOutput_geoColor; }
reference_output_10 = CodeBlock { ref; }  # unwired: ref

join = List.Join(list0=output.MainOutput, list1=output_3.MainOutput, list2=output_4.MainOutput, list3=output_5.MainOutput, list4=output_6.MainOutput, list5=output_2.MainOutput, list6=output_7.MainOutput, list7=output_8.MainOutput, list8=output_9.MainOutput, list9=output_10.MainOutput)

# group: TargetWMunique + Data Sending
code_block_69 = CodeBlock(InputDic2=join) { _InputDic2; }
count_12 = List.Count(list=code_block_69)
code_block_70 = CodeBlock(InputDic1=code_block_4) { _InputDic1; }
code_block_71 = CodeBlock { "TargetWMunique"; }
valueAtKey_14 = DesignScript.Builtin.Dictionary.ValueAtKey(dictionary=code_block_70, key=code_block_71)
watch_3 = Watch(valueAtKey_14)
count_13 = List.Count(list=watch_3)
eq = count_12 == count_13
organizeFuncValuesAndWorkMasterAsDiction = Custom[OrganizeFuncValuesAndWorkMasterAsDictionary](InputDic1=code_block_70, InputDic2=code_block_69)
watch_4 = Watch()  # unwired: arg0
if_2 = If(test=eq, true=organizeFuncValuesAndWorkMasterAsDiction, false=watch_4)

# group: 데이터 취합 및 Row 방향 정렬
code_block_72 = CodeBlock(InputDic=if_2) { _InputDic; }
code_block_73 = CodeBlock { "TrTargetFamilyCode"; }
valueAtKey_15 = DesignScript.Builtin.Dictionary.ValueAtKey(dictionary=code_block_72, key=code_block_73)
watch_5 = Watch(valueAtKey_15)
flatten_19 = List.Flatten(list=watch_5)
code_block_74 = CodeBlock { "WMforTargetElements"; }
valueAtKey_16 = DesignScript.Builtin.Dictionary.ValueAtKey(dictionary=code_block_72, key=code_block_74)
watch_6 = Watch(valueAtKey_16)
flatten_20 = List.Flatten(list=watch_6)
code_block_75 = CodeBlock { "TargetFuncValues"; }
valueAtKey_17 = DesignScript.Builtin.Dictionary.ValueAtKey(dictionary=code_block_72, key=code_block_75)
watch_7 = Watch(valueAtKey_17)
flatten_21 = List.Flatten(list=watch_7)
code_block_76 = CodeBlock { "TargetFuncValuesUnit"; }
valueAtKey_18 = DesignScript.Builtin.Dictionary.ValueAtKey(dictionary=code_block_72, key=code_block_76)
watch_8 = Watch(valueAtKey_18)
flatten_22 = List.Flatten(list=watch_8)
list_create_4 = List.Create(item0=flatten_19, item1=flatten_20, item2=flatten_21, item3=flatten_22)
transpose_4 = List.Transpose(lists=list_create_4)

# group: <Func 1> Visual Manager
visual_켜기_끄기 = BoolSelector(true)
visual_manager = Python(IN[0]=output_3.RefOutput_geoColor, IN[1]=visual_켜기_끄기)  # CPython3
# ---------- visual_manager.python (18 lines) ----------
# Load the Python Standard and DesignScript Libraries
import sys
import clr
clr.AddReference('ProtoGeometry')
from Autodesk.DesignScript.Geometry import *

# The inputs to this node will be stored as a list in the IN variables.
dataEnteringNode = IN
geoColors = IN[0]
blnForVisual = IN[1]

# Place your code below this line
if blnForVisual == True:
    result = geoColors
else:
    result = 0
# Assign your output to the OUT variable.
OUT = result
# ----------------------------------------

# group: <Func 4> Visual Manager
visual_켜기_끄기_2 = BoolSelector(true)
visual_manager_2 = Python(IN[0]=output_6.RefOutput_geoColor, IN[1]=visual_켜기_끄기_2)  # CPython3; same code as visual_manager

# group: <Func 5> Visual Manager
visual_켜기_끄기_3 = BoolSelector(true)
visual_manager_3 = Python(IN[0]=output_2.RefOutput_geoColor, IN[1]=visual_켜기_끄기_3)  # CPython3; same code as visual_manager

# group: <Func 6> Visual Manager
visual_켜기_끄기_4 = BoolSelector(true)
visual_manager_4 = Python(IN[0]=output_7.RefOutput_geoColor, IN[1]=visual_켜기_끄기_4)  # CPython3; same code as visual_manager

# group: <Func 6> Visual Manager
visual_켜기_끄기_5 = BoolSelector(true)
visual_manager_5 = Python(IN[0]=output_10.RefOutput_geoColor, IN[1]=visual_켜기_끄기_5)  # CPython3; same code as visual_manager

watch_9 = Watch(select_target_family_element_and)

# group: 사용된 패밀리 타입 종류 확인 구간
code_block_77 = CodeBlock { "ElementType"; }
valueAtKey_19 = DesignScript.Builtin.Dictionary.ValueAtKey(dictionary=set_up_all_element_inform_as, key=code_block_77)
uniqueItems_2 = List.UniqueItems(list=valueAtKey_19)
watch_10 = Watch(uniqueItems_2)
code_block_78 = CodeBlock { "FamilyCode"; }
valueAtKey_20 = DesignScript.Builtin.Dictionary.ValueAtKey(dictionary=set_up_all_element_inform_as, key=code_block_78)
uniqueItems_3 = List.UniqueItems(list=valueAtKey_20)
watch_11 = Watch(uniqueItems_3)

# group: Input Manager
value_for_import_from_others_12 = CodeBlock(MainInput=code_block_4) { MainInput; RefInput1; RefInput2; }  # unwired: RefInput1, RefInput2

# group: <Func 00>Crushed Stone
code_block_79 = CodeBlock { "TargetElements"; }
valueAtKey_21 = DesignScript.Builtin.Dictionary.ValueAtKey(dictionary=value_for_import_from_others_12.MainInput, key=code_block_79)
# note: <Func>
code_block_80 = CodeBlock { 300; 100; }
createBaseCourseSurfaces_2 = Custom[CreateBaseCourseSurfaces](Element=valueAtKey_21, BaseCourseOffsetBottom=code_block_80.out0, leanThick=code_block_80.out1)
boolean = BoolSelector(false)
thicken = Surface.Thicken(surface=createBaseCourseSurfaces_2.Surface, thickness=code_block_80.out0, both_sides=boolean)
volume_6 = Solid.Volume(solid=thicken)
code_block_81 = CodeBlock(i=volume_6) { Math.Round(List.Flatten(i)/1000000000, 2); }
code_block_82 = CodeBlock { "M3"; }
count_14 = List.Count(list=code_block_81)
ofRepeatedItem_12 = List.OfRepeatedItem(item=code_block_82, amount=count_14)
code_block_83 = CodeBlock(FuncValues=code_block_81, FuncValuesUnit=ofRepeatedItem_12)  # same code as code_block_9

# group: Output Manager
output_11 = CodeBlock(MainOutput=code_block_83) { MainOutput; RefOutput_geoColor; }  # unwired: RefOutput_geoColor
reference_output_11 = CodeBlock { ref; }  # unwired: ref

code_block_84 = CodeBlock(i=set_up_all_element_inform_as) { i["ElementType"]; }
uniqueItems_4 = List.UniqueItems(list=code_block_84)
code_block_85 = CodeBlock { getTargetGeometry; }  # unwired: getTargetGeometry
code_block_86 = CodeBlock { calculate; }  # unwired: calculate
code_block_87 = CodeBlock { correctValue; }  # unwired: correctValue
assemble_function = Python(IN[0]=code_block_85, IN[1]=code_block_86, IN[2]=code_block_87)  # CPython3; frozen
# ---------- assemble_function.python (20 lines) ----------
# Load the Python Standard and DesignScript Libraries
import sys
import clr
clr.AddReference('ProtoGeometry')
from Autodesk.DesignScript.Geometry import *

# The inputs to this node will be stored as a list in the IN variables.
dataEnteringNode = IN

# Place your code below this line
def judgeWM(wm, elem):
    if elem.element
    pass

def assembleFunc(targetGeofunc, getvaluefunc, correctfunc):
    pass


# Assign your output to the OUT variable.
OUT = 0
# ----------------------------------------
name = Element.Name(element=removeItemAtIndex)
create_calcds = Python(IN[0]=excelDataManagerNode)  # CPython3; unwired: IN[1], IN[2]
# ---------- create_calcds.python (64 lines) ----------
# Load the Python Standard and DesignScript Libraries
import sys
import clr
clr.AddReference('ProtoGeometry')
from Autodesk.DesignScript.Geometry import *

# The inputs to this node will be stored as a list in the IN variables.
dataEnteringNode = IN
allElem = IN[0]["AllElement"]
wmCodePerElem = IN[0]["WorkMasterCodePerElementBoth"]
wmDescPerElem = IN[0]["FullWMCodeDescriptionPerElement"]

def pairForDs(allElem, wmDescPerElem):
    result = []
    for i in range(len(allElem)):
        result.append((allElem[i], wmDescPerElem[i]))
    return result
    
allPair = pairForDs(allElem, wmDescPerElem)
# Place your code below this line

    
def create_CalcDS(pair):
    #init#
    elem = pair[0]
    wmDescPerElem = pair[1]
    name = elem.Name
    familyCode = name.split("_")[0]
    geometry = elem.Geometry()[0]
    familyClass = elem.ElementType.GetParameterValueByName("Family Name")
    def findLevel():
        if "Wall" in familyClass:
            level = elem.GetParameterValueByName("Base Constraint")
        elif "Column" in familyClass:
            level = elem.GetParameterValueByName("Base Level")
        elif "Stair" in familyClass:
            level = elem.GetParameterValueByName("Base Level")
        elif "Beam" in familyClass:
            level = elem.GetParameterValueByName("Reference Level")
        else:
            level = elem.GetParameterValueByName("Level")
        return level
    level = findLevel()
    
    result = {
        "name": name,
        "elem": elem,
        "familyCode": familyCode,
        "familyClass": familyClass,
        "level": level,
        "geometry": geometry,
        "wmDescPerElem": wmDescPerElem,
        #"": ,
        }
    return result

#result = list(
#                map(lambda i:
#                    map(lambda j: create_CalcDS(i, j), wmDescPerElem)
#                , allElem)
#              )
result = [create_CalcDS(i) for i in allPair]
# Assign your output to the OUT variable.
OUT = result
# ----------------------------------------
code_block_88 = CodeBlock(i=create_calcds)
# ---------- code_block_88.designscript (2 lines) ----------
i[0];
//["geometry"];
# ----------------------------------------
elementType = Element.ElementType(element=code_block_2._InputElement)
parameters = Element.Parameters(element=elementType)
code_block_89 = CodeBlock { "Family Name"; }
getParameterValueByName_5 = Element.GetParameterValueByName(element=elementType, parameterName=code_block_89)
boolean_2 = BoolSelector(false)
excavationBttmOffset = DoubleInput(300)  # graph input
leanThk = DoubleInput(50)  # graph input
경사_비율_입력_1_x_for_isofdn_2 = DoubleInput(2)  # graph input
getexcavationtarget = Python(IN[1]=boolean_2, IN[3]=excavationBttmOffset, IN[4]=leanThk, IN[5]=경사_비율_입력_1_x_for_isofdn_2)  # CPython3; unwired: IN[0], IN[2]
# ---------- getexcavationtarget.python (106 lines) ----------
# Load the Python Standard and DesignScript Libraries
import sys
import clr

clr.AddReference('RevitAPI')
from Autodesk.Revit.DB import *
import Autodesk

clr.AddReference('RevitNodes')
import Revit
clr.ImportExtensions(Revit.Elements)

clr.AddReference('RevitServices')
import RevitServices
from RevitServices.Persistence import DocumentManager
doc = DocumentManager.Instance.CurrentDBDocument
collector = FilteredElementCollector(doc)#Autodesk.Revit.DB.FilteredElementCollector(doc)

clr.AddReference('ProtoGeometry')
from Autodesk.DesignScript.Geometry import *

allFdns = collector.OfCategory(BuiltInCategory.OST_StructuralFoundation).WhereElementIsNotElementType().ToElements()
allIsoFdns = [i.ToDSType(False) for i in allFdns if "Footing-" in i.Name]

# The inputs to this node will be stored as a list in the IN variables.
dataEnteringNode = IN
refFunc = IN[0]
wholeExcavationBln = IN[1]
inputDS = IN[2]
bttmOffset = IN[3]
leanThk = IN[4]
slopeExcav = IN[5]



# Place your code below this line

def getExcavationTarget(input):
    targets = []
    
    if wholeExcavationBln:
        fdnsGeo = [i.Geometry()[0] for i in allIsoFdns]
        bdBox_fdn = BoundingBox.ByGeometry(fdnsGeo).ToCuboid()
        srfs = bdBox_fdn.Explode()
        belowSrf = [i for i in srfs if i.NormalAtParameter(0.5,0.5).Z == -1][0]
        def getSrfHeight(srf):
            _crvs = srf.PerimeterCurves()
            heights = [i.StartPoint.Z for i in _crvs]
            height = min(heights)
            return height
        belowSrf_height = getSrfHeight(belowSrf)
        
        def findLeanThk(leanobj):
            if leanobj:
                return leanobj.GetParameterValueByName("thk")
            else:
                return leanThk
        leanobj = None
        leanthk = findLeanThk(leanobj)
        
        def offsetCrv(crv, offset=300):
            return crv.Offset(offset)
        def correctElev(crv, thk):
            return crv.Translate(0,0,thk)
        _exca_belowbdry = offsetCrv(PolyCurve.ByJoinedCurves(belowSrf.PerimeterCurves()), bttmOffset)
        exca_belowbdry = correctElev(_exca_belowbdry, -leanthk)
        _exca_upperbdry = correctElev(_exca_belowbdry, -belowSrf_height)
        exca_upperbdry = offsetCrv(_exca_upperbdry, -belowSrf_height/slopeExcav)
        exca_solid = Solid.ByLoft([exca_belowbdry,exca_upperbdry])
        
        #return (exca_solid,exca_upperbdry)
    else:
        srfs = input.Geometry()[0].Explode()
        belowSrf = [i for i in srfs if i.NormalAtParameter(0.5,0.5).Z == -1][0]
        
        def getSrfHeight(srf):
            _crvs = srf.PerimeterCurves()
            heights = [i.StartPoint.Z for i in _crvs]
            height = min(heights)
            return height
        belowSrf_height = getSrfHeight(belowSrf)
        
        def findLeanThk(leanobj):
            if leanobj:
                return leanobj.GetParameterValueByName("thk")
            else:
                return leanThk
        leanobj = None
        leanthk = findLeanThk(leanobj)
        
        def offsetCrv(crv, offset=300):
            return crv.Offset(offset)
        def correctElev(crv, thk):
            return crv.Translate(0,0,thk)
        _exca_belowbdry = offsetCrv(PolyCurve.ByJoinedCurves(belowSrf.PerimeterCurves()), bttmOffset)
        exca_belowbdry = correctElev(_exca_belowbdry, -leanthk)
        _exca_upperbdry = correctElev(_exca_belowbdry, -belowSrf_height)
        exca_upperbdry = offsetCrv(_exca_upperbdry, -belowSrf_height/slopeExcav)
        exca_solid = Solid.ByLoft([exca_belowbdry,exca_upperbdry])

    return (exca_solid, sum([i.Volume for i in [exca_solid]]), "M3")

# Assign your output to the OUT variable.
#OUT = fdnsGeo
OUT = (getExcavationTarget,["Footing-Rectangular"],["Excavation"],["M3"])
#OUT = [getExcavationTarget, getExcavationTarget(inputDS, "Excavation")]
# ----------------------------------------
gettargetforbackfill = Python(IN[0]=getexcavationtarget)  # CPython3
# ---------- gettargetforbackfill.python (26 lines) ----------
# Load the Python Standard and DesignScript Libraries
import sys
import clr
clr.AddReference('ProtoGeometry')
from Autodesk.DesignScript.Geometry import *

# The inputs to this node will be stored as a list in the IN variables.
dataEnteringNode = IN
refFunc = IN[0]

# Place your code below this line

def getTargetforBackfill(SettingsDS, WM):
    targets = []
    getTargetforExcavation = refFunc
    reftarget = getTargetforExcavation(SettingsDS, WM)
    refcalcvalue = reftarget
    if "Something" in WM:
        pass
    else:
        targets = SettingsDS["roomDS"]["roomperimeter"]

    return targets

# Assign your output to the OUT variable.
OUT = getTargetforBackfill
# ----------------------------------------
gettargetfordisposal = Python()  # CPython3; unwired: IN[0]
# ---------- gettargetfordisposal.python (24 lines) ----------
# Load the Python Standard and DesignScript Libraries
import sys
import clr
clr.AddReference('ProtoGeometry')
from Autodesk.DesignScript.Geometry import *

# The inputs to this node will be stored as a list in the IN variables.
dataEnteringNode = IN
refFunc = IN[0]

# Place your code below this line

def getTargetforDisposal(SettingsDS, WM):
    targets = []
    
    if "Something" in WM:
        pass
    else:
        targets = SettingsDS["roomDS"]["roomperimeter"]

    return targets

# Assign your output to the OUT variable.
OUT = getTargetforDisposal
# ----------------------------------------
python_script = Python()  # CPython3; unwired: IN[0]
# ---------- python_script.python (28 lines) ----------
# Load the Python Standard and DesignScript Libraries
import sys
import clr
clr.AddReference('ProtoGeometry')
from Autodesk.DesignScript.Geometry import *

# The inputs to this node will be stored as a list in the IN variables.
dataEnteringNode = IN

# Place your code below this line
#def three_generator():
#    a = [1,2,3]
#    for i in a:
#        yield i*i
#        
#a = three_generator()
#b = (lambda i: i + 3, a)


def findLeanThk(leanobj):
    if leanobj:
        return leanobj.GetParameterValueByName("thk")
    else:
        return 100
        
b = findLeanThk(None)
# Assign your output to the OUT variable.
OUT = b
# ----------------------------------------
seeVisual = Python()  # CPython3; unwired: IN[0]; starter script, not edited (OUT = 0)
createElemDS = Python(IN[0]=set_up_all_element_inform_as)  # CPython3
# ---------- createElemDS.python (31 lines) ----------
# Load the Python Standard and DesignScript Libraries
import sys
import clr
clr.AddReference('ProtoGeometry')
from Autodesk.DesignScript.Geometry import *

# The inputs to this node will be stored as a list in the IN variables.
dataEnteringNode = IN
elemDics = IN[0]
elems = elemDics["Element"]
elemTypes = elemDics["ElementType"]
WMperElems = elemDics["FullWMCodeDescriptionPerElement"]
idx = range(len(elems))
# Place your code below this line
def ElemDS(i, elems, elemTypes, WMperElems):
    elem = elems[i]
    elemType = elemTypes[i]
    familyCode = elemType.split('_')[0]
    WMperElem = WMperElems[i]
    
    result = {
        "elem": elem,
        "elemType": elemType,
        "familyCode": familyCode,
        "WMperElem": WMperElem,
    }
    
    return result

# Assign your output to the OUT variable.
OUT = [ElemDS(i, elems, elemTypes, WMperElems) for i in idx]
# ----------------------------------------
getconcretetarget = Python()  # CPython3; unwired: IN[0]
# ---------- getconcretetarget.python (33 lines) ----------
# Load the Python Standard and DesignScript Libraries
import sys
import clr
clr.AddReference('RevitAPI')
from Autodesk.Revit.DB import *
import Autodesk

clr.AddReference('RevitNodes')
import Revit
clr.ImportExtensions(Revit.Elements)

clr.AddReference('RevitServices')
import RevitServices
from RevitServices.Persistence import DocumentManager
doc = DocumentManager.Instance.CurrentDBDocument
collector = FilteredElementCollector(doc)#Autodesk.Revit.DB.FilteredElementCollector(doc)

clr.AddReference('ProtoGeometry')
from Autodesk.DesignScript.Geometry import *

from itertools import chain

# The inputs to this node will be stored as a list in the IN variables.
dataEnteringNode = IN
_inputs = IN[0]
# Place your code below this line
def getConcreteTarget(input):
    target = input
    
    return (target, target.GetParameterValueByName("Volume"), "M3")

# Assign your output to the OUT variable.
OUT = (getConcreteTarget,["Footing-Rectangular","SOG"],[": Structural Concrete"],["M3"])
# ----------------------------------------
getformworktarget = Python()  # CPython3; unwired: IN[0]
# ---------- getformworktarget.python (35 lines) ----------
# Load the Python Standard and DesignScript Libraries
import sys
import clr
clr.AddReference('RevitAPI')
from Autodesk.Revit.DB import *
import Autodesk

clr.AddReference('RevitNodes')
import Revit
clr.ImportExtensions(Revit.Elements)

clr.AddReference('RevitServices')
import RevitServices
from RevitServices.Persistence import DocumentManager
doc = DocumentManager.Instance.CurrentDBDocument
collector = FilteredElementCollector(doc)#Autodesk.Revit.DB.FilteredElementCollector(doc)

clr.AddReference('ProtoGeometry')
from Autodesk.DesignScript.Geometry import *

from itertools import chain

# The inputs to this node will be stored as a list in the IN variables.
dataEnteringNode = IN
_inputs = IN[0]
# Place your code below this line
def getFormWorkTarget(input):
    geo = input.Geometry()[0]
    allSrf = geo.Explode()
    sideSrf = [i for i in allSrf if round(i.NormalAtParameter(0.5,0.5).Z)==0]
    
    return (sideSrf, sum([i.Area for i in sideSrf]), "M2")

# Assign your output to the OUT variable.
OUT = (getFormWorkTarget,["Footing-Rectangular"],[": Form"],["M2"])
# ----------------------------------------
funcs_set = Python(IN[0]=getconcretetarget, IN[1]=getformworktarget, IN[2]=getexcavationtarget)  # CPython3
# ---------- funcs_set.python (13 lines) ----------
# Load the Python Standard and DesignScript Libraries
import sys
import clr
clr.AddReference('ProtoGeometry')
from Autodesk.DesignScript.Geometry import *

# The inputs to this node will be stored as a list in the IN variables.
dataEnteringNode = IN

# Place your code below this line

# Assign your output to the OUT variable.
OUT = IN
# ----------------------------------------
getTargetAndValue_old = Python(IN[0]=createElemDS, IN[1]=funcs_set)  # CPython3; frozen
# ---------- getTargetAndValue_old.python (48 lines) ----------
# Load the Python Standard and DesignScript Libraries
import sys
import clr
clr.AddReference('ProtoGeometry')
from Autodesk.DesignScript.Geometry import *

# The inputs to this node will be stored as a list in the IN variables.
dataEnteringNode = IN
elemDSs = IN[0]
funcs = IN[1]
#func = IN[1][0]
#funcfamilyTag = IN[1][1]
#funcWmTag = IN[1][2]
#funcUnitTag = IN[1][3]
# Place your code below this line

#elemDS = elemDSs[0]
def getTarget(elemDS, funcs):
    elem = elemDS["elem"]
    etype = elemDS["elemType"]
    familyCode = elemDS["familyCode"]
    wms = elemDS["WMperElem"]
    result = []
    def matchWM_func(wm, funcs):
        result = []
        for i in funcs:
            
            if i[1][0] in etype:
                tmp1 = []
                for j in i[2]:#func의 공종태그
                    if j in wm:
                        tmp1.append(True)
                    else:
                        tmp1.append(False)
                func = i[0]
                if any(tmp1):
                    result.append([etype, wm, func, func(elem)])
                else:
                    result.append([etype, wm,"no matched function"])
        return result

    result = [matchWM_func(wm, funcs) for wm in wms]

    return result

# Assign your output to the OUT variable.
OUT = [getTarget(elemDS, funcs) for elemDS in elemDSs]
#OUT = [getTarget(i, funcs) for i in elemDSs]
# ----------------------------------------
byLoft_3 = Solid.ByLoft()  # unwired: crossSections
byGeometry_2 = BoundingBox.ByGeometry()  # unwired: geom
python_script_2 = Python(IN[0]=valueAtKey_3)  # CPython3
# ---------- python_script_2.python (13 lines) ----------
# Load the Python Standard and DesignScript Libraries
import sys
import clr
clr.AddReference('ProtoGeometry')
from Autodesk.DesignScript.Geometry import *

# The inputs to this node will be stored as a list in the IN variables.
dataEnteringNode = IN
e = IN[0][0]
# Place your code below this line

# Assign your output to the OUT variable.
OUT = type(e)
# ----------------------------------------
getTargetAndValue = Python(IN[0]=createElemDS, IN[1]=funcs_set)  # CPython3
# ---------- getTargetAndValue.python (55 lines) ----------
# Load the Python Standard and DesignScript Libraries
import sys
import clr
clr.AddReference('ProtoGeometry')
from Autodesk.DesignScript.Geometry import *

from itertools import chain

# The inputs to this node will be stored as a list in the IN variables.
dataEnteringNode = IN
elemDSs = IN[0]
funcSets = IN[1]
#func = IN[1][0]
#funcfamilyTag = IN[1][1]
#funcWmTag = IN[1][2]
#funcUnitTag = IN[1][3]
# Place your code below this line

#elemDS = elemDSs[0]
def getTarget(elemDS, funcSets):
    elem = elemDS["elem"]
    etype = elemDS["elemType"]
    familyCode = elemDS["familyCode"]
    wms = elemDS["WMperElem"]
    result = []
    
    def matchWM_func(wms, funcSet):
        result = []
        func = funcSet[0]
        for wm in wms:
            tmp1 = []
            tmp2 = []
            for i in funcSet[1]:
                if i in etype:#element type 비교
                    tmp1.append(True)
                else:
                    tmp1.append(False)
            for i in funcSet[2]:#work type 비교
                if i in wm:
                    tmp2.append(True)
                else:
                    tmp2.append(False)
            if any(tmp1) and any(tmp2):
                result.append([etype, wm, func, func(elem)])
            else:
                result.append([etype, wm,"no matched function"])

        return result

    result = [matchWM_func(wms, funcSet) for funcSet in funcSets]

    return result

# Assign your output to the OUT variable.
OUT = list(chain(*[getTarget(elemDS, funcSets) for elemDS in elemDSs]))
# ----------------------------------------
watch_12 = Watch(getTargetAndValue)

# group: <Func 0> Structural Concrete
code_block_90 = CodeBlock { "TargetElements"; }
valueAtKey_22 = DesignScript.Builtin.Dictionary.ValueAtKey(dictionary=value_for_import_from_others.MainInput, key=code_block_90)
code_block_91 = CodeBlock { "Volume"; }
# note: <Func>
getParameterValueByName_6 = Element.GetParameterValueByName(element=valueAtKey_22, parameterName=code_block_91)
code_block_92 = CodeBlock(i=getParameterValueByName_6) { Math.Round(List.Flatten(i)/1, 2); }
code_block_93 = CodeBlock { "M3"; }
count_15 = List.Count(list=code_block_92)
ofRepeatedItem_13 = List.OfRepeatedItem(item=code_block_93, amount=count_15)
code_block_94 = CodeBlock(FuncValues=code_block_92, FuncValuesUnit=ofRepeatedItem_13)  # same code as code_block_9

getParameterValueByName_7 = Element.GetParameterValueByName()  # unwired: element, parameterName
