# Dynamo graph 20220104Stair Test.dyn (Dynamo 2.10.1.3976)

categories = Categories("OST_StairsLandings")
all_elements_of_category = ElementsOfCategory(Category=categories)
type = Object.Type(obj=all_elements_of_category)
code_block = CodeBlock { "Type"; }
getParameterValueByName = Element.GetParameterValueByName(element=all_elements_of_category, parameterName=code_block)
name = Element.Name(element=getParameterValueByName)
code_block_2 = CodeBlock(i=all_elements_of_category) { i[0]; }
geometry = Element.Geometry(element=code_block_2)
python_script = Python(IN[0]=geometry)  # CPython3
# ---------- python_script.python (15 lines) ----------
# Load the Python Standard and DesignScript Libraries
import sys
import clr
clr.AddReference('ProtoGeometry')
from Autodesk.DesignScript.Geometry import *

# The inputs to this node will be stored as a list in the IN variables.
dataEnteringNode = IN
inpElem = IN[0]
# Place your code below this line
a = list(map(lambda i: i.Explode(), inpElem))
    

# Assign your output to the OUT variable.
OUT = a
# ----------------------------------------
parameters = Element.Parameters(element=code_block_2)
categories_2 = Categories("OST_StairsRuns")
all_elements_of_category_2 = ElementsOfCategory(Category=categories_2)
