# Dynamo graph Elements_Filtering_1.0.0.dyn "Elements_Filtering_rC" (Dynamo 2.16.1.2727)
# author: MK Jang
# Filtering Elements by given condition and Isolating them in view

target_view = Views("{3D}")  # graph input

# group: All Elements in Revit
all_elementsexceptrails = Python()  # CPython3; unwired: IN[0]
# ---------- all_elementsexceptrails.python (51 lines) ----------
# Load the Python Standard and DesignScript Libraries
import sys
import clr
clr.AddReference('ProtoGeometry')
from Autodesk.DesignScript.Geometry import *

clr.AddReference('RevitAPI')
from Autodesk.Revit.DB import *
import Autodesk

clr.AddReference('RevitServices')
import RevitServices
from RevitServices.Persistence import DocumentManager
doc = DocumentManager.Instance.CurrentDBDocument

def get_all_BIC():

    db = [
    Autodesk.Revit.DB.BuiltInCategory.OST_Floors,
    Autodesk.Revit.DB.BuiltInCategory.OST_Roofs,
    Autodesk.Revit.DB.BuiltInCategory.OST_Walls,
    Autodesk.Revit.DB.BuiltInCategory.OST_StructuralFoundation,
    Autodesk.Revit.DB.BuiltInCategory.OST_StructuralColumns,
    Autodesk.Revit.DB.BuiltInCategory.OST_StructuralFraming,
    Autodesk.Revit.DB.BuiltInCategory.OST_Ceilings,
    Autodesk.Revit.DB.BuiltInCategory.OST_Doors,
    Autodesk.Revit.DB.BuiltInCategory.OST_Windows,
    Autodesk.Revit.DB.BuiltInCategory.OST_Stairs,
    #Autodesk.Revit.DB.BuiltInCategory.OST_Railings,
    ]
    return db
    
def get_allElems(doc):
    bics = get_all_BIC()
    
    def getElems(x):
        collector = FilteredElementCollector(doc)
        res = collector.OfCategory(x).WhereElementIsNotElementType().ToElements()
        return res

    def getRailElems(x):
        collector = FilteredElementCollector(doc)
        res = collector.OfCategory(x).WhereElementIsNotElementType()
        return res

    res = map(getElems, bics)
#    res = getRailElems(Autodesk.Revit.DB.BuiltInCategory.OST_RailingSystemRail)
    return res


OUT = get_allElems(doc)
# ----------------------------------------
categories = Categories("OST_StairsRailing")
all_elements_of_category = ElementsOfCategory(Category=categories)
list_create = List.Create(item0=all_elements_of_category)
join = List.Join(list0=all_elementsexceptrails, list1=list_create)
flatten = List.Flatten(list=join)

타겟_파라미터_이름 = CustomSelection("Type", items={Type: "Type", Family and Type: "Family and Type", H_Revision: "H_Revision", Mark: "Mark", Level: "Level", Comments: "Comments"})  # graph input
getParamValueByNameAsStr = Python(IN[0]=flatten, IN[1]=타겟_파라미터_이름)  # CPython3
# ---------- getParamValueByNameAsStr.python (30 lines) ----------
# Load the Python Standard and DesignScript Libraries
import sys
import clr
clr.AddReference('ProtoGeometry')
from Autodesk.DesignScript.Geometry import *

import Revit


# The inputs to this node will be stored as a list in the IN variables.
dataEnteringNode = IN

allElems = IN[0]
inputParamName = IN[1]
# Place your code below this line
def getParamValueByNameAsStr(elem, inputParamName):
    allParam = elem.Parameters
    allParamNames = list(map(lambda x: x.Name, allParam))
    if inputParamName in allParamNames:
        targetIdx = allParamNames.index(inputParamName)
        res = str(allParam[targetIdx])
    else:
        res = ""
    
    return res

res = map(lambda x: getParamValueByNameAsStr(x, inputParamName), allElems)
# Assign your output to the OUT variable.

OUT = res
# ----------------------------------------
포함여부_확인_문자열 = StringInput("ACW")  # graph input
contains = String.Contains(string=getParamValueByNameAsStr, searchFor=포함여부_확인_문자열)
filterByBoolMask = List.FilterByBoolMask(list=flatten, mask=contains)
isolateElementsTemporary = View.IsolateElementsTemporary(view=target_view, elements=filterByBoolMask.in)
parameters = Element.Parameters(element=flatten)
