# Dynamo graph Elements_Filtering_1.1.0.dyn (Dynamo 2.16.1.2727)
# author: MK Jang
# Filtering Elements by given condition and Isolating them in view

n0_target_view = Views("{3D}")  # "0. Target View"; graph input

# group: All Elements in Revit
all_elementsexceptrails = Python()  # CPython3; unwired: IN[0]
# ---------- all_elementsexceptrails.python (52 lines) ----------
# Load the Python Standard and DesignScript Libraries
import sys
import clr
clr.AddReference('ProtoGeometry')
from Autodesk.DesignScript.Geometry import *

clr.AddReference('RevitAPI')
from Autodesk.Revit.DB import *
import Autodesk

clr.AddReference('RevitServices')
import RevitServices
from RevitServices.Persistence import DocumentManager


def get_all_BIC():

    db = [
    Autodesk.Revit.DB.BuiltInCategory.OST_Floors,
    Autodesk.Revit.DB.BuiltInCategory.OST_Roofs,
    Autodesk.Revit.DB.BuiltInCategory.OST_Walls,
    Autodesk.Revit.DB.BuiltInCategory.OST_StructuralFoundation,
    Autodesk.Revit.DB.BuiltInCategory.OST_StructuralColumns,
    Autodesk.Revit.DB.BuiltInCategory.OST_StructuralFraming,
    Autodesk.Revit.DB.BuiltInCategory.OST_Ceilings,
    Autodesk.Revit.DB.BuiltInCategory.OST_Doors,
    Autodesk.Revit.DB.BuiltInCategory.OST_Windows,
    Autodesk.Revit.DB.BuiltInCategory.OST_Stairs,
    #Autodesk.Revit.DB.BuiltInCategory.OST_Railings,
    ]
    return db
    
def get_allElems():
    doc = DocumentManager.Instance.CurrentDBDocument
    bics = get_all_BIC()
    
    def getElems(x):
        collector = FilteredElementCollector(doc)
        res = collector.OfCategory(x).WhereElementIsNotElementType().ToElements()
        return res

    def getRailElems(x):
        collector = FilteredElementCollector(doc)
        res = collector.OfCategory(x).WhereElementIsNotElementType()
        return res

    res = map(getElems, bics)
#    res = getRailElems(Autodesk.Revit.DB.BuiltInCategory.OST_RailingSystemRail)
    return res


OUT = get_allElems()
# ----------------------------------------
categories = Categories("OST_StairsRailing")
all_elements_of_category = ElementsOfCategory(Category=categories)
list_create = List.Create(item0=all_elements_of_category)
join = List.Join(list0=all_elementsexceptrails, list1=list_create)
flatten = List.Flatten(list=join)

n3_키워드_판별_모드 = CustomSelection("'And' 모드", items={'And' 모드: "0", 'Or' 모드: "1", 'Nor' 모드: "2"})  # "3. 키워드 판별 모드**"; graph input
n1_타겟_파라미터_이름 = CustomSelection("Type", items={Type: "Type", Family and Type: "Family and Type", H_Revision: "H_Revision", Mark: "Mark", Level: "Level", Comments: "Comments"})  # "1. 타겟 파라미터 이름"; graph input
getParamValueByNameAsStr = Python(IN[0]=flatten, IN[1]=n1_타겟_파라미터_이름)  # CPython3
# ---------- getParamValueByNameAsStr.python (30 lines) ----------
# Load the Python Standard and DesignScript Libraries
import sys
import clr
clr.AddReference('ProtoGeometry')
from Autodesk.DesignScript.Geometry import *

import Revit


# The inputs to this node will be stored as a list in the IN variables.
dataEnteringNode = IN

allElems = IN[0]
inputParamName = IN[1]
# Place your code below this line
def getParamValueByNameAsStr(elem, inputParamName):
    allParam = elem.Parameters
    allParamNames = list(map(lambda x: x.Name, allParam))
    if inputParamName in allParamNames:
        targetIdx = allParamNames.index(inputParamName)
        res = str(allParam[targetIdx])
    else:
        res = ""
    
    return res

res = map(lambda x: getParamValueByNameAsStr(x, inputParamName), allElems)
# Assign your output to the OUT variable.

OUT = res
# ----------------------------------------
n2_포함여부_확인_문자열 = StringInput("Please enter the string to be used in the filtering operation.")  # "2. 포함여부 확인 문자열"; graph input
code_block = CodeBlock { ","; }
확인_문자열_split = Python(IN[0]=n2_포함여부_확인_문자열, IN[1]=code_block)  # CPython3
# ---------- 확인_문자열_split.python (15 lines) ----------
# Load the Python Standard and DesignScript Libraries
import sys
import clr
clr.AddReference('ProtoGeometry')
from Autodesk.DesignScript.Geometry import *

# The inputs to this node will be stored as a list in the IN variables.
dataEnteringNode = IN
inStr = IN[0]
# Place your code below this line

split_res = map(lambda x: x.strip(), inStr.split(','))

# Assign your output to the OUT variable.
OUT = split_res
# ----------------------------------------
포함여부_판별 = Python(IN[0]=n3_키워드_판별_모드, IN[1]=getParamValueByNameAsStr, IN[2]=확인_문자열_split)  # CPython3
# ---------- 포함여부_판별.python (48 lines) ----------
# Load the Python Standard and DesignScript Libraries
import sys
import clr
clr.AddReference('ProtoGeometry')
from Autodesk.DesignScript.Geometry import *

# The inputs to this node will be stored as a list in the IN variables.
dataEnteringNode = IN
discr_mode_bln = IN[0]
elemsPropList = IN[1]
inStrList = IN[2]

# Place your code below this line
def find_IsInStr(target, str):
    if target == None or str == None:
        pass
    else:
        res = target in str
        return res


def IsContainStr(discr_mode_bln, elemsPropList, inStrList):
    elemsPropStrList = list(map(str, elemsPropList))
    if discr_mode_bln == 0:
        res = []
        for i in elemsPropStrList:
            tmp = []
            for j in inStrList:
                tmp.append(find_IsInStr(j,i))
            res.append(all(tmp))
    elif discr_mode_bln == 1:
        res = []
        for i in elemsPropStrList:
            tmp = []
            for j in inStrList:
                tmp.append(find_IsInStr(j,i))
            res.append(any(tmp))
    elif discr_mode_bln == 2:
        res = []
        for i in elemsPropStrList:
            tmp = []
            for j in inStrList:
                tmp.append(find_IsInStr(j,i))
            res.append(not(any(tmp)))
    return res

# Assign your output to the OUT variable.
OUT = IsContainStr(discr_mode_bln, elemsPropList, inStrList)
# ----------------------------------------
filterByBoolMask = List.FilterByBoolMask(list=flatten, mask=포함여부_판별)
isolateElementsTemporary = View.IsolateElementsTemporary(view=n0_target_view, elements=filterByBoolMask.in)
parameters = Element.Parameters(element=flatten)
allelementsfrom_linkedrvt = Python()  # CPython3; unwired: IN[0]
# ---------- allelementsfrom_linkedrvt.python (124 lines) ----------
# Load the Python Standard and DesignScript Libraries
import sys
import clr
clr.AddReference("ProtoGeometry")
from Autodesk.DesignScript.Geometry import *
## Import ToDSType(bool) extension method
clr.AddReference("RevitNodes")
import Revit
clr.ImportExtensions(Revit.Elements)
## Import geometry conversion extension methods
clr.ImportExtensions(Revit.GeometryConversion)
## Import DocumentManager and TransactionManager
clr.AddReference("RevitServices")
import RevitServices
from RevitServices.Persistence import DocumentManager
from RevitServices.Transactions import TransactionManager
from System.Collections.Generic import *

## Import RevitAPI
clr.AddReference("RevitAPI")
import Autodesk
from Autodesk.Revit.DB import *

#clr.AddReference("DSCoreNodes")
#import DSCore
#from DSCore.List import *

doc = DocumentManager.Instance.CurrentDBDocument
uiapp = DocumentManager.Instance.CurrentUIApplication
app = uiapp.Application
uidoc=DocumentManager.Instance.CurrentUIApplication.ActiveUIDocument

lnks = FilteredElementCollector(doc).OfClass(RevitLinkInstance)

# The inputs to this node will be stored as a list in the IN variables.
dataEnteringNode = IN

# Place your code below this line
def get_all_BIC():

    db = [
    Autodesk.Revit.DB.BuiltInCategory.OST_Floors,
    Autodesk.Revit.DB.BuiltInCategory.OST_Roofs,
    Autodesk.Revit.DB.BuiltInCategory.OST_Walls,
    Autodesk.Revit.DB.BuiltInCategory.OST_StructuralFoundation,
    Autodesk.Revit.DB.BuiltInCategory.OST_StructuralColumns,
    Autodesk.Revit.DB.BuiltInCategory.OST_StructuralFraming,
    Autodesk.Revit.DB.BuiltInCategory.OST_Ceilings,
    Autodesk.Revit.DB.BuiltInCategory.OST_Doors,
    Autodesk.Revit.DB.BuiltInCategory.OST_Windows,
    Autodesk.Revit.DB.BuiltInCategory.OST_Stairs,
    #Autodesk.Revit.DB.BuiltInCategory.OST_Railings,
    ]
    return db

def get_allElems(doc,bics):
    #bics = get_all_BIC()
    
    def getElems(x):
        collector = FilteredElementCollector(doc)
        res = collector.OfCategory(x).WhereElementIsNotElementType().ToElements()
        return res

    def getRailElems(x):
        collector = FilteredElementCollector(doc)
        res = collector.OfCategory(x).WhereElementIsNotElementType()
        return res

    res = map(getElems, bics)





def getAllElemFromLinkedRVT(lnks):
    bics = get_all_BIC()
    TransactionManager.Instance.EnsureInTransaction(doc)
    res = []
    for i in lnks:
        doclnk = i.GetLinkDocument()
        coll = get_allElems(doclnk,bics)
        
        
        res.append(coll)
    TransactionManager.Instance.TransactionTaskDone()
        
    return res

#out = getAllElemFromLinkedRVT(lnks)

## Start Transaction
TransactionManager.Instance.EnsureInTransaction(doc)

out = []
for i in lnks:
    doclnk = i.GetLinkDocument()
    coll = [
    FilteredElementCollector(doclnk).OfCategory(BuiltInCategory.OST_Floors).WhereElementIsNotElementType().ToElements(),
    FilteredElementCollector(doclnk).OfCategory(BuiltInCategory.OST_Roofs).WhereElementIsNotElementType().ToElements(),
    FilteredElementCollector(doclnk).OfCategory(BuiltInCategory.OST_Walls).WhereElementIsNotElementType().ToElements(),
    FilteredElementCollector(doclnk).OfCategory(BuiltInCategory.OST_StructuralFoundation).WhereElementIsNotElementType().ToElements(),
    FilteredElementCollector(doclnk).OfCategory(BuiltInCategory.OST_StructuralColumns).WhereElementIsNotElementType().ToElements(),
    FilteredElementCollector(doclnk).OfCategory(BuiltInCategory.OST_StructuralFraming).WhereElementIsNotElementType().ToElements(),
    FilteredElementCollector(doclnk).OfCategory(BuiltInCategory.OST_Ceilings).WhereElementIsNotElementType().ToElements(),
    FilteredElementCollector(doclnk).OfCategory(BuiltInCategory.OST_Doors).WhereElementIsNotElementType().ToElements(),
    FilteredElementCollector(doclnk).OfCategory(BuiltInCategory.OST_Windows).WhereElementIsNotElementType().ToElements(),
    FilteredElementCollector(doclnk).OfCategory(BuiltInCategory.OST_Stairs).WhereElementIsNotElementType().ToElements(),
    ]
    res = filter(lambda x: x != [], coll)
    out.append(res)

## End the Transaction
TransactionManager.Instance.TransactionTaskDone()




OUT = out




# Assign your output to the OUT variable.
#OUT = out
# ----------------------------------------
flatten_2 = List.Flatten(list=allelementsfrom_linkedrvt)
code_block_2 = CodeBlock { "Please enter the string to be used in the filtering operation."; }
