# Dynamo graph Elements_Filtering_rB.dyn (Dynamo 2.16.1.2727)
# author: MK Jang
# Filtering Elements by given condition and Isolating them in view

target_view = Views("{3D}")  # graph input

# group: All Elements in Revit
all_elementsexceptrails = Python()  # CPython3; unwired: IN[0]
# ---------- all_elementsexceptrails.python (51 lines) ----------
# Load the Python Standard and DesignScript Libraries
import sys
import clr
clr.AddReference('ProtoGeometry')
from Autodesk.DesignScript.Geometry import *

clr.AddReference('RevitAPI')
from Autodesk.Revit.DB import *
import Autodesk

clr.AddReference('RevitServices')
import RevitServices
from RevitServices.Persistence import DocumentManager
doc = DocumentManager.Instance.CurrentDBDocument

def get_all_BIC():

    db = [
    Autodesk.Revit.DB.BuiltInCategory.OST_Floors,
    Autodesk.Revit.DB.BuiltInCategory.OST_Roofs,
    Autodesk.Revit.DB.BuiltInCategory.OST_Walls,
    Autodesk.Revit.DB.BuiltInCategory.OST_StructuralFoundation,
    Autodesk.Revit.DB.BuiltInCategory.OST_StructuralColumns,
    Autodesk.Revit.DB.BuiltInCategory.OST_StructuralFraming,
    Autodesk.Revit.DB.BuiltInCategory.OST_Ceilings,
    Autodesk.Revit.DB.BuiltInCategory.OST_Doors,
    Autodesk.Revit.DB.BuiltInCategory.OST_Windows,
    Autodesk.Revit.DB.BuiltInCategory.OST_Stairs,
    #Autodesk.Revit.DB.BuiltInCategory.OST_Railings,
    ]
    return db
    
def get_allElems(doc):
    bics = get_all_BIC()
    
    def getElems(x):
        collector = FilteredElementCollector(doc)
        res = collector.OfCategory(x).WhereElementIsNotElementType().ToElements()
        return res

    def getRailElems(x):
        collector = FilteredElementCollector(doc)
        res = collector.OfCategory(x).WhereElementIsNotElementType()
        return res

    res = map(getElems, bics)
#    res = getRailElems(Autodesk.Revit.DB.BuiltInCategory.OST_RailingSystemRail)
    return res


OUT = get_allElems(doc)
# ----------------------------------------
categories = Categories("OST_StairsRailing")
all_elements_of_category = ElementsOfCategory(Category=categories)
list_create = List.Create(item0=all_elements_of_category)
join = List.Join(list0=all_elementsexceptrails, list1=list_create)
flatten = List.Flatten(list=join)

타겟_파라미터_이름 = CustomSelection("Type", items={Type: "Type", H_Revision: "H_Revision", Mark: "Mark", Level: "Level", Comments: "Comments"})  # graph input
getParameterValueByName = Element.GetParameterValueByName(element=flatten, parameterName=타겟_파라미터_이름)
string_from_object = FromObject(object=getParameterValueByName)
포함여부_확인_문자열 = StringInput("ASB")  # graph input
contains = String.Contains(string=string_from_object, searchFor=포함여부_확인_문자열)
filterByBoolMask = List.FilterByBoolMask(list=flatten, mask=contains)
isolateElementsTemporary = View.IsolateElementsTemporary(view=target_view, elements=filterByBoolMask.in)
parameters = Element.Parameters(element=flatten)
