# Dynamo graph exceltest.dyn (Dynamo 2.16.1.2727)

file_path = Filename("D:\mk\mQ\hecCalc\2023\documentum\11.xlsx")
code_block = CodeBlock { ["Sheet1","Sheet2"]; }
code_block_2 = CodeBlock { 0; }
code_block_3 = CodeBlock()
# ---------- code_block_3.designscript (4 lines) ----------
[
[[1,2,3,4,5]],
[[6,7,8,9,10]]
];
# ----------------------------------------
transpose = List.Transpose(lists=code_block_3@L2)
exportToExcel = Data.ExportToExcel(filePath=file_path, sheetName=code_block@L1, startRow=code_block_2, startColumn=code_block_2, data=transpose@L2)
