# Dynamo graph hCalc_rA(20230901).dyn (Dynamo 2.16.1.2727)

# group: All Elements in Revit
all_elementsexceptrails = Python()  # CPython3; unwired: IN[0]
# ---------- all_elementsexceptrails.python (51 lines) ----------
# Load the Python Standard and DesignScript Libraries
import sys
import clr
clr.AddReference('ProtoGeometry')
from Autodesk.DesignScript.Geometry import *

clr.AddReference('RevitAPI')
from Autodesk.Revit.DB import *
import Autodesk

clr.AddReference('RevitServices')
import RevitServices
from RevitServices.Persistence import DocumentManager
doc = DocumentManager.Instance.CurrentDBDocument

def get_all_BIC():

    db = [
    Autodesk.Revit.DB.BuiltInCategory.OST_Floors,
    Autodesk.Revit.DB.BuiltInCategory.OST_Roofs,
    Autodesk.Revit.DB.BuiltInCategory.OST_Walls,
    Autodesk.Revit.DB.BuiltInCategory.OST_StructuralFoundation,
    Autodesk.Revit.DB.BuiltInCategory.OST_StructuralColumns,
    Autodesk.Revit.DB.BuiltInCategory.OST_StructuralFraming,
    Autodesk.Revit.DB.BuiltInCategory.OST_Ceilings,
    Autodesk.Revit.DB.BuiltInCategory.OST_Doors,
    Autodesk.Revit.DB.BuiltInCategory.OST_Windows,
    Autodesk.Revit.DB.BuiltInCategory.OST_Stairs,
    #Autodesk.Revit.DB.BuiltInCategory.OST_Railings,
    ]
    return db
    
def get_allElems(doc):
    bics = get_all_BIC()
    
    def getElems(x):
        collector = FilteredElementCollector(doc)
        res = collector.OfCategory(x).WhereElementIsNotElementType().ToElements()
        return res

    def getRailElems(x):
        collector = FilteredElementCollector(doc)
        res = collector.OfCategory(x).WhereElementIsNotElementType()
        return res

    res = map(getElems, bics)
#    res = getRailElems(Autodesk.Revit.DB.BuiltInCategory.OST_RailingSystemRail)
    return res


OUT = get_allElems(doc)
# ----------------------------------------
categories = Categories("OST_StairsRailing")
all_elements_of_category = ElementsOfCategory(Category=categories)
list_create = List.Create(item0=all_elements_of_category)
join = List.Join(list0=all_elementsexceptrails, list1=list_create)

floors = CodeBlock(i=join) { i[0]; }  # "01.Floors"

# group: All Data in Excel
file_path = Filename(".\플랜트건축팀_BIM_팀 표준 Family List_Rev.0_SQ2_박기범_20230904.xlsx")
file_from_path = FileObject(path=file_path)
code_block = CodeBlock()
# ---------- code_block.designscript (15 lines) ----------
[
"물량Param",
"1.Floors",
"2.Roofs",
"3.Walls",
"4.St Fdn",
"5.St Col",
"6.St Framing",
"7.Ceilings",
"8.Doors",
"9.Windows",
"10.Stairs",
"11.Railings",
"13.Generic"
];
# ----------------------------------------
boolean = BoolSelector(true)
importExcel = Data.ImportExcel(file=file_from_path, sheetName=code_block, showExcel=boolean)

# group: 물량 파라미터시트 / 그 외 구분
deconstruct = List.Deconstruct(list=importExcel)

floors_2 = CodeBlock(i=deconstruct.rest) { i[0]; }

# group: Math.EvaluateFormula 테스트
code_block_2 = CodeBlock { "a * v"; }
code_block_3 = CodeBlock { ["a","v"]; }
code_block_4 = CodeBlock { [15,63]; }
evaluateFormula = Math.EvaluateFormula(formulaString=code_block_2, parameters=code_block_3, arguments=code_block_4)

code_block_5 = CodeBlock()
# ---------- code_block_5.designscript (11 lines) ----------
// 부재별로 최종 정리될 서브 리스트 구성 :

// 패밀리 Type 코드

// WM 코드들

// 수식

// 수식 참여 문자

// 수식 참여 문자의 값 (엑셀 입력값 + 레빗 인스턴스 속성 값 + 레빗 타입 속성 값)
# ----------------------------------------
n5_st_col = CodeBlock(i=deconstruct.rest) { i[4]; }  # "5. St Col"
code_block_6 = CodeBlock(i=n5_st_col) { i; }
transpose = List.Transpose(lists=code_block_6)
col_stt_end = CodeBlock { "E"; "-"; }
row_분할_기준_인덱스_산출 = Python(IN[0]=code_block_6, IN[1]=col_stt_end.out0, IN[2]=col_stt_end.out1)  # CPython3
# ---------- row_분할_기준_인덱스_산출.python (73 lines) ----------
# Load the Python Standard and DesignScript Libraries
import sys
import clr
clr.AddReference('ProtoGeometry')
from Autodesk.DesignScript.Geometry import *

from functools import reduce
from functools import partial
from string import ascii_lowercase

def getCharValue(s):
    # 베이스 케이스
    if not s:
        return 0
 
    value = 0
    # 입력 문자열을 대문자로 변환한 후 반복
    for ch in s:
        value = value * 26 + (ord(ch) - ord('A') + 1)
    return value
    
#################################Module For Functional Programing#############################################
curry = lambda f: lambda a,*args: f(a, *args) if (len(args)) else lambda *args: f(a, *args)

filter = curry(filter)
map = curry(map)

def _take(length, iter):
    res = []
    for a in iter:
        res.append(a)
        if len(res) == length:
            return res
        
take = curry(_take)
reduce = curry(reduce)

go = lambda *args: reduce(lambda a,f: f(a), args) ## 함수도 축약 가능 ##
##############################################################################################################

# The inputs to this node will be stored as a list in the IN variables.
dataEnteringNode = IN
db = IN[0]
col_idx = getCharValue(IN[1])-2
#row_stt = IN[2]-1
sep_rule = IN[2]


# Place your code below this line
def find_IsInStr(target, str):
    if target == None or str == None:
        pass
    else:
        res = target in str
        return res

def find_range_by_columnItem(db, col_idx, sep_rule):
    tdb = list(map(lambda x: x[col_idx], db))
    last_idx_tdb = len(tdb)-1
    tdb_enum = enumerate(tdb)
    res = list(filter(lambda x: find_IsInStr(sep_rule, x[1]), tdb_enum))
    endidxs_tmp= list(map(lambda x: x[0]-1,res))
    endidxs_tmp.pop(0)
    endidxs = endidxs_tmp + [last_idx_tdb]
    a = list(map(lambda x: x[1],res))
    b = list(map(lambda x: x[0],res))
    c = endidxs
    result = zip(a,b,c)
    return result

# Assign your output to the OUT variable.
#OUT = col_idx
OUT = find_range_by_columnItem(db, col_idx, sep_rule)
# ----------------------------------------
deconstruct_2 = List.Deconstruct(list=row_분할_기준_인덱스_산출@L2)

# group: 시트 타입별 분할 처리 구간 - 카테고리 시트
code_block_7 = CodeBlock(trDatas=transpose, sep_idxs=deconstruct_2.rest) { trDatas; sep_idxs; }
firstItem = List.FirstItem(list=code_block_7.sep_idxs@L2)
lastItem = List.LastItem(list=code_block_7.sep_idxs@L2)
code_block_8 = CodeBlock(i=lastItem) { i+1; }
slice = List.Slice(list=code_block_7.trDatas@L2, start=firstItem, end=code_block_8)
code_block_9 = CodeBlock(i=firstItem) { i+1; }

# group: "A : [B : C]" Dictionary "Family Type : [WM code : 물량산출식]" Dictionary
code_block_10 = CodeBlock(i=slice) { i; }
A = CodeBlock(i=code_block_10) { i[4]; }
firstItem_2 = List.FirstItem(list=A@L2)
C = CodeBlock(i=code_block_10) { i[28]; }
code_block_11 = CodeBlock { 1; }
dropItems = List.DropItems(list=C@L2, amount=code_block_11)
isNull = Object.IsNull(object=dropItems)
code_block_12 = CodeBlock { false; }
allIndicesOf = List.AllIndicesOf(list=isNull@L2, item=code_block_12)
getItemAtIndex = List.GetItemAtIndex(list=dropItems@L2, index=allIndicesOf@L2)
isEmpty = List.IsEmpty(list=getItemAtIndex@L2)
code_block_13 = CodeBlock { false; }
allIndicesOf_2 = List.AllIndicesOf(list=isEmpty, item=code_block_13)
getItemAtIndex_2 = List.GetItemAtIndex(list=firstItem_2, index=allIndicesOf_2)
B = CodeBlock(i=code_block_10) { i[5]; }
dropItems_2 = List.DropItems(list=B@L2, amount=code_block_11)
getItemAtIndex_3 = List.GetItemAtIndex(list=dropItems_2@L2, index=allIndicesOf@L2)
getItemAtIndex_4 = List.GetItemAtIndex(list=getItemAtIndex_3, index=allIndicesOf_2)
getItemAtIndex_5 = List.GetItemAtIndex(list=getItemAtIndex, index=allIndicesOf_2)
byKeysValues = DesignScript.Builtin.Dictionary.ByKeysValues(keys=getItemAtIndex_4@L2, values=getItemAtIndex_5@L2)
byKeysValues_2 = DesignScript.Builtin.Dictionary.ByKeysValues(keys=getItemAtIndex_2, values=byKeysValues)

stCol = CodeBlock(i=join) { i[4]; }  # "05.StCol"
code_block_14 = CodeBlock { "Type"; }
getParameterValueByName = Element.GetParameterValueByName(element=stCol, parameterName=code_block_14)
name = ElementType.Name(elementType=getParameterValueByName)
string_from_object = FromObject(object=name)
valueAtKey = DesignScript.Builtin.Dictionary.ValueAtKey(dictionary=byKeysValues_2, key=string_from_object)

# group: "Family Type : WM codes" Dictionary // 필요없을지도?
code_block_15 = CodeBlock(i=slice) { i[4]; }
deconstruct_3 = List.Deconstruct(list=code_block_15@L2)
code_block_16 = CodeBlock(i=slice) { i[5]; }
code_block_17 = CodeBlock { false; }
clean = List.Clean(list=code_block_16, preserveIndices=code_block_17)
byKeysValues_3 = DesignScript.Builtin.Dictionary.ByKeysValues(keys=deconstruct_3.first, values=clean)

components = DesignScript.Builtin.Dictionary.Components(dictionary=byKeysValues_2)
components_2 = DesignScript.Builtin.Dictionary.Components(dictionary=components.values)
물량Param시트 = CodeBlock(i=deconstruct.first) { i; }
transpose_2 = List.Transpose(lists=물량Param시트)
col_stt_end_2 = CodeBlock { "D"; "-"; }
row_분할_기준_인덱스_산출_2 = Python(IN[0]=물량Param시트, IN[1]=col_stt_end_2.out0, IN[2]=col_stt_end_2.out1)  # CPython3; same code as row_분할_기준_인덱스_산출
deconstruct_4 = List.Deconstruct(list=row_분할_기준_인덱스_산출_2@L2)

# group: 시트 타입별 분할 처리 구간 - 물량Param 시트
code_block_18 = CodeBlock(trDatas=transpose_2, sep_idxs=deconstruct_4.rest) { trDatas; sep_idxs; }
firstItem_3 = List.FirstItem(list=code_block_18.sep_idxs@L2)
lastItem_2 = List.LastItem(list=code_block_18.sep_idxs@L2)
code_block_19 = CodeBlock(i=lastItem_2) { i+1; }
slice_2 = List.Slice(list=code_block_18.trDatas@L2, start=firstItem_3, end=code_block_19)

# group: "A : [B : C]" Dictionary "Calc Type : [산출수식 약자 : 입력값]" Dictionary
code_block_20 = CodeBlock(i=slice_2) { i; }
A_2 = CodeBlock(i=code_block_20) { i[2]; }
C_2 = CodeBlock(i=code_block_20) { i[6]; }
isNull_2 = Object.IsNull(object=C_2)
code_block_21 = CodeBlock { false; }
allIndicesOf_3 = List.AllIndicesOf(list=isNull_2@L2, item=code_block_21)
getItemAtIndex_6 = List.GetItemAtIndex(list=C_2@L2, index=allIndicesOf_3@L2)
isEmpty_2 = List.IsEmpty(list=getItemAtIndex_6@L2)
code_block_22 = CodeBlock { false; }
allIndicesOf_4 = List.AllIndicesOf(list=isEmpty_2, item=code_block_22)
getItemAtIndex_7 = List.GetItemAtIndex(list=A_2, index=allIndicesOf_4)
deconstruct_5 = List.Deconstruct(list=getItemAtIndex_7@L2)
B_2 = CodeBlock(i=code_block_20) { i[5]; }
getItemAtIndex_8 = List.GetItemAtIndex(list=B_2@L2, index=allIndicesOf_3@L2)
getItemAtIndex_9 = List.GetItemAtIndex(list=getItemAtIndex_8, index=allIndicesOf_4)
getItemAtIndex_10 = List.GetItemAtIndex(list=getItemAtIndex_6, index=allIndicesOf_4)
byKeysValues_4 = DesignScript.Builtin.Dictionary.ByKeysValues(keys=getItemAtIndex_9@L2, values=getItemAtIndex_10@L2)
byKeysValues_5 = DesignScript.Builtin.Dictionary.ByKeysValues(keys=deconstruct_5.first, values=byKeysValues_4)

# group: "Family Type : Calc Type" Dictionary
code_block_23 = CodeBlock(i=slice) { i[4]; }
deconstruct_6 = List.Deconstruct(list=code_block_23@L2)
code_block_24 = CodeBlock(i=slice) { i[3]; }
firstItem_4 = List.FirstItem(list=code_block_24@L2)
byKeysValues_6 = DesignScript.Builtin.Dictionary.ByKeysValues(keys=deconstruct_6.first, values=firstItem_4)

valueAtKey_2 = DesignScript.Builtin.Dictionary.ValueAtKey(dictionary=byKeysValues_6, key=string_from_object)
valueAtKey_3 = DesignScript.Builtin.Dictionary.ValueAtKey(dictionary=byKeysValues_5, key=valueAtKey_2)

# group: "A : [B : C]" Dictionary "Calc Type : [산출수식 약자 : 패밀리 타입 매개변수]" Dictionary
code_block_25 = CodeBlock(i=slice_2) { i; }
A_3 = CodeBlock(i=code_block_25) { i[2]; }
C_3 = CodeBlock(i=code_block_25) { i[11]; }
isNull_3 = Object.IsNull(object=C_3)
code_block_26 = CodeBlock { false; }
allIndicesOf_5 = List.AllIndicesOf(list=isNull_3@L2, item=code_block_26)
getItemAtIndex_11 = List.GetItemAtIndex(list=C_3@L2, index=allIndicesOf_5@L2)
isEmpty_3 = List.IsEmpty(list=getItemAtIndex_11@L2)
code_block_27 = CodeBlock { false; }
allIndicesOf_6 = List.AllIndicesOf(list=isEmpty_3, item=code_block_27)
getItemAtIndex_12 = List.GetItemAtIndex(list=A_3, index=allIndicesOf_6)
deconstruct_7 = List.Deconstruct(list=getItemAtIndex_12@L2)
B_3 = CodeBlock(i=code_block_25) { i[5]; }
getItemAtIndex_13 = List.GetItemAtIndex(list=B_3@L2, index=allIndicesOf_5@L2)
getItemAtIndex_14 = List.GetItemAtIndex(list=getItemAtIndex_13, index=allIndicesOf_6)
getItemAtIndex_15 = List.GetItemAtIndex(list=getItemAtIndex_11, index=allIndicesOf_6)
byKeysValues_7 = DesignScript.Builtin.Dictionary.ByKeysValues(keys=getItemAtIndex_14@L2, values=getItemAtIndex_15@L2)
byKeysValues_8 = DesignScript.Builtin.Dictionary.ByKeysValues(keys=deconstruct_7.first, values=byKeysValues_7)

valueAtKey_4 = DesignScript.Builtin.Dictionary.ValueAtKey(dictionary=byKeysValues_8, key=valueAtKey_2)

# group: "A : [B : C]" Dictionary "Calc Type : [산출수식 약자 : 패밀리 인스턴스 매개변수]" Dictionary
code_block_28 = CodeBlock(i=slice_2) { i; }
A_4 = CodeBlock(i=code_block_28) { i[2]; }
C_4 = CodeBlock(i=code_block_28) { i[12]; }
isNull_4 = Object.IsNull(object=C_4)
code_block_29 = CodeBlock { false; }
allIndicesOf_7 = List.AllIndicesOf(list=isNull_4@L2, item=code_block_29)
getItemAtIndex_16 = List.GetItemAtIndex(list=C_4@L2, index=allIndicesOf_7@L2)
isEmpty_4 = List.IsEmpty(list=getItemAtIndex_16@L2)
code_block_30 = CodeBlock { false; }
allIndicesOf_8 = List.AllIndicesOf(list=isEmpty_4, item=code_block_30)
getItemAtIndex_17 = List.GetItemAtIndex(list=A_4, index=allIndicesOf_8)
deconstruct_8 = List.Deconstruct(list=getItemAtIndex_17@L2)
B_4 = CodeBlock(i=code_block_28) { i[5]; }
getItemAtIndex_18 = List.GetItemAtIndex(list=B_4@L2, index=allIndicesOf_7@L2)
getItemAtIndex_19 = List.GetItemAtIndex(list=getItemAtIndex_18, index=allIndicesOf_8)
getItemAtIndex_20 = List.GetItemAtIndex(list=getItemAtIndex_16, index=allIndicesOf_8)
byKeysValues_9 = DesignScript.Builtin.Dictionary.ByKeysValues(keys=getItemAtIndex_19@L2, values=getItemAtIndex_20@L2)
byKeysValues_10 = DesignScript.Builtin.Dictionary.ByKeysValues(keys=deconstruct_8.first, values=byKeysValues_9)

valueAtKey_5 = DesignScript.Builtin.Dictionary.ValueAtKey(dictionary=byKeysValues_10, key=valueAtKey_2)
n6_st_framing = CodeBlock(i=deconstruct.rest) { i[5]; }  # "6. St Framing"
code_block_31 = CodeBlock { 0; }
removeItemAtIndex = List.RemoveItemAtIndex(indices=code_block_31)  # unwired: list
familyName = ElementType.FamilyName()  # unwired: elementType
col_stt_end_3 = CodeBlock { "E"; "-"; }
deconstruct_9 = List.Deconstruct(list=code_block)
family_list_데이터_파싱 = Python(IN[0]=importExcel, IN[1]=deconstruct_9.rest)  # CPython3
# ---------- family_list_데이터_파싱.python (137 lines) ----------
# Load the Python Standard and DesignScript Libraries
import sys
import clr
clr.AddReference('ProtoGeometry')
from Autodesk.DesignScript.Geometry import *

from functools import reduce
from functools import partial
from string import ascii_lowercase

def getCharValue(s):
    # 베이스 케이스
    if not s:
        return 0
 
    value = 0
    # 입력 문자열을 대문자로 변환한 후 반복
    for ch in s:
        value = value * 26 + (ord(ch) - ord('A') + 1)
    return value
    
#################################Module For Functional Programing#############################################
curry = lambda f: lambda a,*args: f(a, *args) if (len(args)) else lambda *args: f(a, *args)

filter = curry(filter)
map = curry(map)

def _take(length, iter):
    res = []
    for a in iter:
        res.append(a)
        if len(res) == length:
            return res
        
take = curry(_take)
reduce = curry(reduce)

go = lambda *args: reduce(lambda a,f: f(a), args) ## 함수도 축약 가능 ##
##############################################################################################################
def find_IsInStr(target, str):
    if target == None or str == None:
        pass
    else:
        res = target in str
        return res

def find_range_by_columnItem(db, col_idx, sep_rule):
    tdb = list(map(lambda x: x[col_idx], db))
    last_idx_tdb = len(tdb)-1
    tdb_enum = enumerate(tdb)
    res = list(filter(lambda x: find_IsInStr(sep_rule, x[1]), tdb_enum))
    endidxs_tmp= list(map(lambda x: x[0]-1,res))
    #endidxs_tmp= list(map(lambda x: x[0],res))
    endidxs_tmp.pop(0)
    endidxs = endidxs_tmp + [last_idx_tdb]
    famTypeNames = list(map(lambda x: x[1],res))
    famTypeNamesIdxs = list(map(lambda x: x[0],res))
    rangeSttIdxs = list(map(lambda x: x[0]+1,res))
    rangeEndIdxs = endidxs
    result = dict(zip(famTypeNames, zip(famTypeNamesIdxs, zip(rangeSttIdxs,rangeEndIdxs))))
    return result

# The inputs to this node will be stored as a list in the IN variables.
dataEnteringNode = IN
db = IN[0]
allCatSheetsNames =IN[1]
#col_idx = getCharValue(IN[2])-2
#sep_rule = IN[3]

paramSheet = db[0]
allCatSheets = db[1:]

# Place your code below this line

## 1.Floors 시트 기준 엑셀 헤더 별 위치 판별 - 함수 작성을 위한 중간단계 예시 코드
#headers_CatSheets = dict(map(lambda x: [x[1].replace("\n",""),x[0]], filter(lambda x: x[1] != None, enumerate(allCatSheets[0][1]))))

#ranges_CatSheets = find_range_by_columnItem(allCatSheets[1], headers_CatSheets["Family Type Name"], "H_")



def find_headersAtCatSheet(catSheet):
    headers_CatSheet = map(lambda x: [x[1].replace("\n",""),x[0]], filter(lambda x: x[1] != None, enumerate(catSheet[1])))
    
    return dict(headers_CatSheet)

def find_rangesAtCatSheet(catSheet, hdrs_withIdx):
    return find_range_by_columnItem(catSheet, hdrs_withIdx["Family Type Name"], "H_")

def get_DataOnRangesAtCatSheet(catSheet):
    hdrs_withIdx = find_headersAtCatSheet(catSheet)
    title_idx = map(lambda x: x[0], find_rangesAtCatSheet(catSheet, hdrs_withIdx).values())
    calcType_colDatas = list(map(lambda x: x[hdrs_withIdx["Q'ty Cal Type Tag"]], catSheet))
    calcTypes = list(map(lambda x: calcType_colDatas[x], title_idx))
    rgs_v = list(map(lambda x: x[1], find_rangesAtCatSheet(catSheet, hdrs_withIdx).values()))
    rgs_k = list(map(lambda x: x, find_rangesAtCatSheet(catSheet, hdrs_withIdx).keys()))
    
    hdrs_v = list(hdrs_withIdx.values())
    hdrs_k = list(hdrs_withIdx.keys())
    tagDatas = list(zip(rgs_k,calcTypes))
    
    datas_allFamType = list(map(lambda x: catSheet[x[0]:x[1]], rgs_v))
    #datas_allFamType = list(zip(tagDatas, datas_allFamType_))
    
    def setDict_OnEachFamType(data_famType,tagDatas):
        famTypeName = tagDatas[0]
        calcTypeName = tagDatas[1]
        data_famType_noneless = list(filter(lambda x: x[5] != None, data_famType))
        ## WM row 별 header명 과 짝짓기
        data_withHdrsIdx = list(map(lambda y: map(lambda x: y[x], hdrs_v), data_famType_noneless))
        dict_ = list(map(lambda x: dict(zip(hdrs_k, x)), data_withHdrsIdx))
        dicts_noneless = list(map(lambda y: dict(filter(lambda x: x[1]!=None, y.items())),dict_))
        ## dict_gauge처리
        targetColName = "Guage Code"
        for d in dicts_noneless:
            d["Family Type Name"] = famTypeName
            d["Q'ty Cal Type Tag"] = calcTypeName
            if targetColName in d.keys():
                pass
            else:
                d[targetColName] = ""
        
        return dicts_noneless
        
    dicts_allFamType = list(map(lambda x: setDict_OnEachFamType(x,tagDatas), datas_allFamType))
    ds_famTypesAtCatSheet = dict(zip(rgs_k, dicts_allFamType))
    ds_famTypesAtCatSheet_noneless = dict(filter(lambda x: len(list(x[1]))!=0, list(ds_famTypesAtCatSheet.items())))
    
    return tagDatas#ds_famTypesAtCatSheet_noneless
    
dataOnRanges_allCat = map(get_DataOnRangesAtCatSheet, allCatSheets)
# Assign your output to the OUT variable.

#OUT = find_rangesAtCatSheet(allCatSheets[1])
#OUT = find_headersAtCatSheet(allCatSheets[1])
#OUT = get_DataOnRangesAtCatSheet(allCatSheets[0])
OUT = dataOnRanges_allCat
# ----------------------------------------
watch = Watch(family_list_데이터_파싱)
family_list_데이터_파싱_debug용 = Python(IN[0]=importExcel, IN[1]=deconstruct_9.rest)  # CPython3
# ---------- family_list_데이터_파싱_debug용.python (142 lines) ----------
# Load the Python Standard and DesignScript Libraries
import sys
import clr
clr.AddReference('ProtoGeometry')
from Autodesk.DesignScript.Geometry import *

from functools import reduce
from functools import partial
from string import ascii_lowercase

def getCharValue(s):
    # 베이스 케이스
    if not s:
        return 0
 
    value = 0
    # 입력 문자열을 대문자로 변환한 후 반복
    for ch in s:
        value = value * 26 + (ord(ch) - ord('A') + 1)
    return value
    
#################################Module For Functional Programing#############################################
curry = lambda f: lambda a,*args: f(a, *args) if (len(args)) else lambda *args: f(a, *args)

filter = curry(filter)
map = curry(map)

def _take(length, iter):
    res = []
    for a in iter:
        res.append(a)
        if len(res) == length:
            return res
        
take = curry(_take)
reduce = curry(reduce)

go = lambda *args: reduce(lambda a,f: f(a), args) ## 함수도 축약 가능 ##
##############################################################################################################
def find_IsInStr(target, str):
    if target == None or str == None:
        pass
    else:
        res = target in str
        return res

def find_range_by_columnItem(db, col_idx, sep_rule):
    tdb = list(map(lambda x: x[col_idx], db))
    last_idx_tdb = len(tdb)-1
    tdb_enum = enumerate(tdb)
    res = list(filter(lambda x: find_IsInStr(sep_rule, x[1]), tdb_enum))
    endidxs_tmp= list(map(lambda x: x[0]-1,res))
    #endidxs_tmp= list(map(lambda x: x[0],res))
    endidxs_tmp.pop(0)
    endidxs = endidxs_tmp + [last_idx_tdb]
    famTypeNames = list(map(lambda x: x[1],res))
    famTypeNamesIdxs = list(map(lambda x: x[0],res))
    rangeSttIdxs = list(map(lambda x: x[0]+1,res))
    rangeEndIdxs = endidxs
    result = dict(zip(famTypeNames, zip(famTypeNamesIdxs, zip(rangeSttIdxs,rangeEndIdxs))))
    return result

# The inputs to this node will be stored as a list in the IN variables.
dataEnteringNode = IN
db = IN[0]
allCatSheetsNames =IN[1]
#col_idx = getCharValue(IN[2])-2
#sep_rule = IN[3]

paramSheet = db[0]
allCatSheets = db[1:]

# Place your code below this line

## 1.Floors 시트 기준 엑셀 헤더 별 위치 판별 - 함수 작성을 위한 중간단계 예시 코드
#headers_CatSheets = dict(map(lambda x: [x[1].replace("\n",""),x[0]], filter(lambda x: x[1] != None, enumerate(allCatSheets[0][1]))))

#ranges_CatSheets = find_range_by_columnItem(allCatSheets[1], headers_CatSheets["Family Type Name"], "H_")



def find_headersAtCatSheet(catSheet):
    headers_CatSheet = map(lambda x: [x[1].replace("\n",""),x[0]], filter(lambda x: x[1] != None, enumerate(catSheet[1])))
    
    return dict(headers_CatSheet)

def find_rangesAtCatSheet(catSheet, hdrs_withIdx):
    return find_range_by_columnItem(catSheet, hdrs_withIdx["Family Type Name"], "H_")

def get_DataOnRangesAtCatSheet(catSheet):
    hdrs_withIdx = find_headersAtCatSheet(catSheet)
    title_idx = map(lambda x: x[0], find_rangesAtCatSheet(catSheet, hdrs_withIdx).values())
    calcType_colDatas = list(map(lambda x: x[hdrs_withIdx["Q'ty Cal Type Tag"]], catSheet))
    calcTypes = list(map(lambda x: calcType_colDatas[x], title_idx))
    rgs_v = list(map(lambda x: x[1], find_rangesAtCatSheet(catSheet, hdrs_withIdx).values()))
    rgs_k = list(map(lambda x: x, find_rangesAtCatSheet(catSheet, hdrs_withIdx).keys()))
    
    hdrs_v = list(hdrs_withIdx.values())
    hdrs_k = list(hdrs_withIdx.keys())
    tagDatas = list(zip(rgs_k,calcTypes))
    
    datas_allFamType = list(map(lambda x: catSheet[x[0]-1:x[1]], rgs_v))
    #datas_allFamType = list(zip(tagDatas, datas_allFamType_))
    
    def setDict_OnEachFamType(data_famType):
        titleData = data_famType.pop(0)
        famTypeName = titleData[hdrs_withIdx["Family Type Name"]]
        calcTypeName = titleData[hdrs_withIdx["Q'ty Cal Type Tag"]]
        data_famType_noneless = list(filter(lambda x: x[5] != None, data_famType))
        ## WM row 별 header명 과 짝짓기
        data_withHdrsIdx = list(map(lambda y: list(map(lambda x: y[x], hdrs_v)), data_famType_noneless))
        dict_ = list(map(lambda x: dict(zip(hdrs_k, x)), data_withHdrsIdx))
        dicts_noneless = list(map(lambda y: dict(filter(lambda x: x[1]!=None, y.items())),dict_))
        ## dict_gauge처리
        targetColName = "Guage Code"
        for d in dicts_noneless:
            d["Family Type Name"] = famTypeName
#            d["Q'ty Cal Type Tag"] = calcTypeName
            if calcTypeName == None:
                pass            
            elif targetColName in d.keys():
                pass
            else:
                d["Q'ty Cal Type Tag"] = calcTypeName
                d[targetColName] = ""
        
        return dicts_noneless
        
    dicts_allFamType = list(map(lambda x: setDict_OnEachFamType(x), datas_allFamType))
    ds_famTypesAtCatSheet = dict(zip(rgs_k, dicts_allFamType))
    ds_famTypesAtCatSheet_noneless = dict(filter(lambda x: len(list(x[1]))!=0, list(ds_famTypesAtCatSheet.items())))
    #ds_famTypesAtCatSheet_effCalcType = dict(filter(lambda x: "Q'ty Cal Type Tag" in x[1].keys(), list(ds_famTypesAtCatSheet_noneless.items())))
    
    return ds_famTypesAtCatSheet_noneless
    
dataOnRanges_allCat = map(get_DataOnRangesAtCatSheet, allCatSheets)
# Assign your output to the OUT variable.

#OUT = find_rangesAtCatSheet(allCatSheets[1])
#OUT = find_headersAtCatSheet(allCatSheets[1])
#OUT = get_DataOnRangesAtCatSheet(allCatSheets[0])
OUT = dataOnRanges_allCat
# ----------------------------------------
watch_2 = Watch(family_list_데이터_파싱_debug용)
family_list_데이터_파싱_debug용2 = Python(IN[0]=importExcel, IN[1]=deconstruct_9.rest)  # CPython3
# ---------- family_list_데이터_파싱_debug용2.python (144 lines) ----------
# Load the Python Standard and DesignScript Libraries
import sys
import clr
clr.AddReference('ProtoGeometry')
from Autodesk.DesignScript.Geometry import *

from functools import reduce
from functools import partial
from string import ascii_lowercase

def getCharValue(s):
    # 베이스 케이스
    if not s:
        return 0
 
    value = 0
    # 입력 문자열을 대문자로 변환한 후 반복
    for ch in s:
        value = value * 26 + (ord(ch) - ord('A') + 1)
    return value
    
#################################Module For Functional Programing#############################################
curry = lambda f: lambda a,*args: f(a, *args) if (len(args)) else lambda *args: f(a, *args)

filter = curry(filter)
map = curry(map)

def _take(length, iter):
    res = []
    for a in iter:
        res.append(a)
        if len(res) == length:
            return res
        
take = curry(_take)
reduce = curry(reduce)

go = lambda *args: reduce(lambda a,f: f(a), args) ## 함수도 축약 가능 ##
##############################################################################################################
def find_IsInStr(target, str):
    if target == None or str == None:
        pass
    else:
        res = target in str
        return res

def find_range_by_columnItem(db, col_idx, sep_rule):
    tdb = list(map(lambda x: x[col_idx], db))
    last_idx_tdb = len(tdb)-1
    tdb_enum = enumerate(tdb)
    res = list(filter(lambda x: find_IsInStr(sep_rule, x[1]), tdb_enum))
    endidxs_tmp= list(map(lambda x: x[0]-1,res))
    #endidxs_tmp= list(map(lambda x: x[0],res))
    endidxs_tmp.pop(0)
    endidxs = endidxs_tmp + [last_idx_tdb]
    famTypeNames = list(map(lambda x: x[1],res))
    famTypeNamesIdxs = list(map(lambda x: x[0],res))
    rangeSttIdxs = list(map(lambda x: x[0]+1,res))
    rangeEndIdxs = endidxs
    result = dict(zip(famTypeNames, zip(famTypeNamesIdxs, zip(rangeSttIdxs,rangeEndIdxs))))
    return result

# The inputs to this node will be stored as a list in the IN variables.
dataEnteringNode = IN
db = IN[0]
allCatSheetsNames =IN[1]
#col_idx = getCharValue(IN[2])-2
#sep_rule = IN[3]

paramSheet = db[0]
allCatSheets = db[1:]

# Place your code below this line

## 1.Floors 시트 기준 엑셀 헤더 별 위치 판별 - 함수 작성을 위한 중간단계 예시 코드
#headers_CatSheets = dict(map(lambda x: [x[1].replace("\n",""),x[0]], filter(lambda x: x[1] != None, enumerate(allCatSheets[0][1]))))

#ranges_CatSheets = find_range_by_columnItem(allCatSheets[1], headers_CatSheets["Family Type Name"], "H_")



def find_headersAtCatSheet(catSheet):
    headers_CatSheet = map(lambda x: [x[1].replace("\n",""),x[0]], filter(lambda x: x[1] != None, enumerate(catSheet[1])))
    
    return dict(headers_CatSheet)

def find_rangesAtCatSheet(catSheet, hdrs_withIdx):
    return find_range_by_columnItem(catSheet, hdrs_withIdx["Family Type Name"], "H_")

def get_DataOnRangesAtCatSheet(catSheet):
    hdrs_withIdx = find_headersAtCatSheet(catSheet)
    title_idx = map(lambda x: x[0], find_rangesAtCatSheet(catSheet, hdrs_withIdx).values())
    calcType_colDatas = list(map(lambda x: x[hdrs_withIdx["Q'ty Cal Type Tag"]], catSheet))
    calcTypes = list(map(lambda x: calcType_colDatas[x], title_idx))
    rgs_v = list(map(lambda x: x[1], find_rangesAtCatSheet(catSheet, hdrs_withIdx).values()))
    rgs_k = list(map(lambda x: x, find_rangesAtCatSheet(catSheet, hdrs_withIdx).keys()))
    
    hdrs_v = list(hdrs_withIdx.values())
    hdrs_k = list(hdrs_withIdx.keys())
    tagDatas = list(zip(rgs_k,calcTypes))
    
    datas_allFamType = list(map(lambda x: catSheet[x[0]-1:x[1]], rgs_v))
    #datas_allFamType = list(zip(tagDatas, datas_allFamType_))
    
    def setDict_OnEachFamType(data_famType):
        titleData = data_famType.pop(0)
        famTypeName = titleData[hdrs_withIdx["Family Type Name"]]
        calcTypeName = titleData[hdrs_withIdx["Q'ty Cal Type Tag"]]
        data_famType_noneless = list(filter(lambda x: x[5] != None, data_famType))
        ## WM row 별 header명 과 짝짓기
        data_withHdrsIdx = list(map(lambda y: list(map(lambda x: y[x], hdrs_v)), data_famType_noneless))
        dict_ = list(map(lambda x: dict(zip(hdrs_k, x)), data_withHdrsIdx))
        dicts_noneless = list(map(lambda y: dict(filter(lambda x: x[1]!=None, y.items())),dict_))
        ## dict_gauge처리
        targetColName = "Guage Code"
        for d in dicts_noneless:
            d["Family Type Name"] = famTypeName
#            d["Q'ty Cal Type Tag"] = calcTypeName
            if calcTypeName == None:
                pass            
            elif targetColName in d.keys():
                pass
            else:
                d["Q'ty Cal Type Tag"] = calcTypeName
                d[targetColName] = ""
        
        return dicts_noneless
        
    dicts_allFamType = list(map(lambda x: setDict_OnEachFamType(x), datas_allFamType))
    ds_famTypesAtCatSheet = dict(zip(rgs_k, dicts_allFamType))
    #ds_famTypesAtCatSheet_noneless = dict(filter(lambda x: len(list(x[1]))!=0, list(ds_famTypesAtCatSheet.items())))
#    ds_famTypesAtCatSheet_effCalcType = dict(filter(lambda x: all(list(map(lambda i: "Q'ty Cal Type Tag" in i, x[1]))), list(ds_famTypesAtCatSheet_noneless.items())))
    ds_famTypesAtCatSheet_effCalcType = dict(filter(lambda x: all(list(map(lambda i: "Q'ty Cal Type Tag" in i, x[1]))), list(ds_famTypesAtCatSheet.items())))
    ds_famTypesAtCatSheet_noneless = dict(filter(lambda x: len(list(x[1]))!=0, list(ds_famTypesAtCatSheet_effCalcType.items())))
    
    return ds_famTypesAtCatSheet_noneless
    
dataOnRanges_allCat = map(get_DataOnRangesAtCatSheet, allCatSheets)
# Assign your output to the OUT variable.

#OUT = find_rangesAtCatSheet(allCatSheets[1])
#OUT = find_headersAtCatSheet(allCatSheets[1])
#OUT = get_DataOnRangesAtCatSheet(allCatSheets[0])
OUT = dataOnRanges_allCat
# ----------------------------------------
watch_3 = Watch(family_list_데이터_파싱_debug용2)
values = DesignScript.Builtin.Dictionary.Values(dictionary=family_list_데이터_파싱_debug용2)
code_block_32 = CodeBlock { "Q'ty Cal Type Tag"; }
valueAtKey_6 = DesignScript.Builtin.Dictionary.ValueAtKey(dictionary=values@L2, key=code_block_32)
