# Dynamo graph hCalc_rB(20230912).dyn (Dynamo 2.16.1.2727)

# group: Math.EvaluateFormula 테스트
code_block = CodeBlock { "  a * v"; }
code_block_2 = CodeBlock { ["a","v"]; }
code_block_3 = CodeBlock { [15,63]; }
evaluateFormula = Math.EvaluateFormula(formulaString=code_block, parameters=code_block_2, arguments=code_block_3)

code_block_4 = CodeBlock()
# ---------- code_block_4.designscript (11 lines) ----------
// 부재별로 최종 정리될 서브 리스트 구성 :

// 패밀리 Type 코드

// WM 코드들

// 수식

// 수식 참여 문자

// 수식 참여 문자의 값 (엑셀 입력값 + 레빗 인스턴스 속성 값 + 레빗 타입 속성 값)
# ----------------------------------------

# group: All Data in Excel
file_path = Filename(".\플랜트건축팀_BIM_팀 표준 Family List_Rev.0_SQ3_박기범_20230913.xlsx")
file_from_path = FileObject(path=file_path)
code_block_5 = CodeBlock()
# ---------- code_block_5.designscript (15 lines) ----------
[
"물량Param",
"1.Floors",
"2.Roofs",
"3.Walls",
"4.St Fdn",
"5.St Col",
"6.St Framing",
"7.Ceilings",
"8.Doors",
"9.Windows",
"10.Stairs",
"11.Railings"
//,"13.Generic"
];
# ----------------------------------------
boolean = BoolSelector(true)
importExcel = Data.ImportExcel(file=file_from_path, sheetName=code_block_5, showExcel=boolean)
deconstruct = List.Deconstruct(list=code_block_5)

family_list_데이터_파싱_category_시트 = Python(IN[0]=importExcel, IN[1]=deconstruct.rest)  # CPython3
# ---------- family_list_데이터_파싱_category_시트.python (143 lines) ----------
# Load the Python Standard and DesignScript Libraries
import sys
import clr
clr.AddReference('ProtoGeometry')
from Autodesk.DesignScript.Geometry import *

from functools import reduce
from functools import partial
from string import ascii_lowercase

def getCharValue(s):
    # 베이스 케이스
    if not s:
        return 0
 
    value = 0
    # 입력 문자열을 대문자로 변환한 후 반복
    for ch in s:
        value = value * 26 + (ord(ch) - ord('A') + 1)
    return value
    
#################################Module For Functional Programing#############################################
curry = lambda f: lambda a,*args: f(a, *args) if (len(args)) else lambda *args: f(a, *args)

filter = curry(filter)
map = curry(map)

def _take(length, iter):
    res = []
    for a in iter:
        res.append(a)
        if len(res) == length:
            return res
        
take = curry(_take)
reduce = curry(reduce)

go = lambda *args: reduce(lambda a,f: f(a), args) ## 함수도 축약 가능 ##
##############################################################################################################
def find_IsInStr(target, str):
    if target == None or str == None:
        pass
    else:
        res = target in str
        return res

def find_range_by_columnItem(db, col_idx, sep_rule):
    tdb = list(map(lambda x: x[col_idx], db))
    last_idx_tdb = len(tdb)-1
    tdb_enum = enumerate(tdb)
    res = list(filter(lambda x: find_IsInStr(sep_rule, x[1]), tdb_enum))
    endidxs_tmp= list(map(lambda x: x[0]-1,res))
    #endidxs_tmp= list(map(lambda x: x[0],res))
    endidxs_tmp.pop(0)
    endidxs = endidxs_tmp + [last_idx_tdb]
    famTypeNames = list(map(lambda x: x[1],res))
    famTypeNamesIdxs = list(map(lambda x: x[0],res))
    rangeSttIdxs = list(map(lambda x: x[0]+1,res))
    rangeEndIdxs = endidxs
    result = dict(zip(famTypeNames, zip(famTypeNamesIdxs, zip(rangeSttIdxs,rangeEndIdxs))))
    return result

# The inputs to this node will be stored as a list in the IN variables.
dataEnteringNode = IN
db = IN[0]
allCatSheetsNames =IN[1]
#col_idx = getCharValue(IN[2])-2
#sep_rule = IN[3]

paramSheet = db[0]
allCatSheets = db[1:]

# Place your code below this line

def find_headersAtCatSheet(catSheet):
    headers_CatSheet = map(lambda x: [x[1].replace("\n",""),x[0]], filter(lambda x: x[1] != None, enumerate(catSheet[1])))
    
    return dict(headers_CatSheet)

def find_rangesAtCatSheet(catSheet, hdrs_withIdx):
    return find_range_by_columnItem(catSheet, hdrs_withIdx["Family Type Name"], "H_")

def get_DataOnRangesAtCatSheet(catSheet): 
    hdrs_withIdx = find_headersAtCatSheet(catSheet)
    title_idx = map(lambda x: x[0], find_rangesAtCatSheet(catSheet, hdrs_withIdx).values())
    calcType_colDatas = list(map(lambda x: x[hdrs_withIdx["Q'ty Cal Type Tag"]], catSheet))
    calcTypes = list(map(lambda x: calcType_colDatas[x], title_idx))
    rgs_v = list(map(lambda x: x[1], find_rangesAtCatSheet(catSheet, hdrs_withIdx).values()))
    rgs_k = list(map(lambda x: x, find_rangesAtCatSheet(catSheet, hdrs_withIdx).keys()))
    
    hdrs_v = list(hdrs_withIdx.values())
    hdrs_k = list(hdrs_withIdx.keys())
    #tagDatas = list(zip(rgs_k,calcTypes))
    
    datas_allFamType = list(map(lambda x: list(zip(catSheet[x[0]-1:x[1]], range(x[0]-1,x[1]))), rgs_v))
    #datas_allFamType = list(zip(tagDatas, datas_allFamType_))
    
    def setDict_OnEachFamType(data_famType):  ## 최종적으로 산출식 없는 것 걸러내기 추가해야 함
        titleData = list(data_famType).pop(0)[0]
        
        famTypeName = titleData[hdrs_withIdx["Family Type Name"]]
        calcTypeName = titleData[hdrs_withIdx["Q'ty Cal Type Tag"]]
        data_famType_noneless = list(filter(lambda x: x[0][5] != None, data_famType))
        ## WM row 별 header명 과 짝짓기
        data_withHdrsIdx = list(map(lambda y: [list(map(lambda x: y[0][x], hdrs_v)), y[1]], data_famType_noneless))
        hdrs_k.append("rIDX")
        dict_ = list(map(lambda x: dict(zip(hdrs_k, x[0]+[x[1]])), data_withHdrsIdx))
        dicts_noneless = list(map(lambda y: dict(filter(lambda x: x[1]!=None, y.items())),dict_))
        ## dict_gauge, 물량산출식 없는 항목 처리
        dicts_final = []
        needDefault_ColName = "Gauge Code"
        noneRemove_ColName = "Dynamo 물량산출식"
        for d in dicts_noneless:
            d["Family Type Name"] = famTypeName
            
            if calcTypeName == None:
                pass            
            elif noneRemove_ColName in d.keys():
                d["Q'ty Cal Type Tag"] = calcTypeName
                d[needDefault_ColName] = ""
                dicts_final.append(d)

        
        return dicts_final
        
    dicts_allFamType = list(map(lambda x: setDict_OnEachFamType(list(x)), datas_allFamType))
    ds_famTypesAtCatSheet = dict(zip(rgs_k, dicts_allFamType))
    ds_famTypesAtCatSheet_effCalcType = dict(filter(lambda x: all(list(map(lambda i: "Q'ty Cal Type Tag" in i, x[1]))), list(ds_famTypesAtCatSheet.items())))
    ds_famTypesAtCatSheet_noneless = dict(filter(lambda x: len(list(x[1]))!=0, list(ds_famTypesAtCatSheet_effCalcType.items())))
    
    return  ds_famTypesAtCatSheet_noneless

## AllInOne 딕셔너리에 정리
dataOnRanges_allCat = list(map(get_DataOnRangesAtCatSheet, allCatSheets))
dicts_AllInOne = {}
for d in dataOnRanges_allCat:
    dict_k_v = d.items()
    for k,v in dict_k_v:
        dicts_AllInOne[k] = v

# Assign your output to the OUT variable.
OUT = dicts_AllInOne
#OUT = get_DataOnRangesAtCatSheet(allCatSheets[0])
# ----------------------------------------
code_block_6 = CodeBlock()
# ---------- code_block_6.designscript (3 lines) ----------
//모델링 부재랑 만났을때,
//"applyForCalc값이 숫자인 경우는 바로 적용
//숫자가 아닌 경우는 파라미터 값 소환,
# ----------------------------------------
code_block_7 = CodeBlock()
# ---------- code_block_7.designscript (2 lines) ----------
// >>> 레빗 부재 별로 패밀리 타입 엑셀 시트 짝지을때,
// applyForCalc값 중 매개 변수 에 해당 하는 값을 업데이트 하여 딕셔너리 갱신
# ----------------------------------------
code_block_8 = CodeBlock()
# ---------- code_block_8.designscript (9 lines) ----------
// 최종적으로는

// 부재(FamilyType) 별 WM 항목 마다
// 1. 물량산출식
// 2. 산출식 참여 약자 목록 []
// 3. 약자별 대입 값 목록 []


// 이렇게 정리가 되어있어야 한다.
# ----------------------------------------

# group: 임시 - WM 파라미터 생성
spec_types = SpecTypes("autodesk.spec:spec.string")
group_types = GroupTypes("autodesk.parameter.group:materials")
code_block_9 = CodeBlock(specT=spec_types, groupT=group_types)
# ---------- code_block_9.designscript (19 lines) ----------
[
"H_Q'ty Cal Type Tag",
"H_WM Code_1",
"H_WM Code_2",
"H_WM Code_3",
"H_WM Code_4",
"H_WM Code_5",
"H_WM Code_6",
"H_WM Code_7",
"H_WM Code_8",
"H_WM Code_9"
];
"H_WM Code";
specT;
groupT;
false;
//타입;
true;
//인스턴스;
# ----------------------------------------
createProjectParameterForAllCategories = Parameter.CreateProjectParameterForAllCategories(parameterName=code_block_9.out0, groupName=code_block_9.out1, specType=code_block_9.specT, groupType=code_block_9.groupT, instance=code_block_9.out4)  # frozen

# group: Excel data dictionarization
lang_mode_영_한_select = BoolSelector(true)
family_list_데이터_파싱_물량param_시트 = Python(IN[0]=importExcel, IN[1]=deconstruct.first, IN[2]=lang_mode_영_한_select)  # CPython3
# ---------- family_list_데이터_파싱_물량param_시트.python (133 lines) ----------
# Load the Python Standard and DesignScript Libraries
import sys
import clr
clr.AddReference('ProtoGeometry')
from Autodesk.DesignScript.Geometry import *

from functools import reduce
from functools import partial
from string import ascii_lowercase

def getCharValue(s):
    # 베이스 케이스
    if not s:
        return 0
 
    value = 0
    # 입력 문자열을 대문자로 변환한 후 반복
    for ch in s:
        value = value * 26 + (ord(ch) - ord('A') + 1)
    return value
    
#################################Module For Functional Programing#############################################
curry = lambda f: lambda a,*args: f(a, *args) if (len(args)) else lambda *args: f(a, *args)

filter = curry(filter)
map = curry(map)

def _take(length, iter):
    res = []
    for a in iter:
        res.append(a)
        if len(res) == length:
            return res
        
take = curry(_take)
reduce = curry(reduce)

go = lambda *args: reduce(lambda a,f: f(a), args) ## 함수도 축약 가능 ##
##############################################################################################################
def find_IsInStr(target, str):
    if target == None or str == None:
        pass
    else:
        res = target in str
        return res

def find_range_by_columnItem(db, col_idx, sep_rule):
    tdb = list(map(lambda x: x[col_idx], db))
    last_idx_tdb = len(tdb)-1
    tdb_enum = enumerate(tdb)
    res = list(filter(lambda x: find_IsInStr(sep_rule, x[1]), tdb_enum))
    endidxs_tmp= list(map(lambda x: x[0]-1,res))
    #endidxs_tmp= list(map(lambda x: x[0],res))
    endidxs_tmp.pop(0)
    endidxs = endidxs_tmp + [last_idx_tdb]
    famTypeNames = list(map(lambda x: x[1],res))
    famTypeNamesIdxs = list(map(lambda x: x[0],res))
    rangeSttIdxs = list(map(lambda x: x[0]+1,res))
    rangeEndIdxs = endidxs
    result = dict(zip(famTypeNames, zip(famTypeNamesIdxs, zip(rangeSttIdxs,rangeEndIdxs))))
    return result

# The inputs to this node will be stored as a list in the IN variables.
dataEnteringNode = IN
db = IN[0]
allCatSheetsNames =IN[1]
lang_mode = IN[2]

paramSheet = db[0]
allCatSheets = db[1:]

# Place your code below this line

def find_headersAtCatSheet(catSheet):
    headers_CatSheet = map(lambda x: [x[1].replace("\n",""),x[0]], filter(lambda x: x[1] != None, enumerate(catSheet[1])))
    
    return dict(headers_CatSheet)

def find_rangesAtCatSheet(catSheet, hdrs_withIdx):
    return find_range_by_columnItem(catSheet, hdrs_withIdx["Q'ty Cal Type Tag"], "-")

def get_DataOnRangesAtCatSheet(Sheet):
    
    hdrs_withIdx = find_headersAtCatSheet(Sheet)
    title_idx = map(lambda x: x[0], find_rangesAtCatSheet(Sheet, hdrs_withIdx).values())
    calcType_colDatas = list(map(lambda x: x[hdrs_withIdx["Q'ty Cal Type Tag"]], Sheet))
    calcTypes = list(map(lambda x: calcType_colDatas[x], title_idx))
    rgs_v = list(map(lambda x: x[1], find_rangesAtCatSheet(Sheet, hdrs_withIdx).values()))
    rgs_k = list(map(lambda x: x, find_rangesAtCatSheet(Sheet, hdrs_withIdx).keys()))
    
    hdrs_v = list(hdrs_withIdx.values())
    hdrs_k = list(hdrs_withIdx.keys())
    eff_hdrs_v = hdrs_v[2:]
    eff_hdrs_k = hdrs_k[2:]
    
    datas_allCalType = list(map(lambda x: Sheet[x[0]-1:x[1]], rgs_v))
    
    def setDict_OnEachCalType(data_calType):
        paramName_lang = "패밀리 매개변수(from Revit) 영문판" if lang_mode is True else "패밀리 매개변수(from Revit) 한글판"
        calcTypeName = data_calType[0][2]
        data_calType_noneless = list(filter(lambda x: x[hdrs_withIdx["항목"]] != None, data_calType))
#        ## WM row 별 header명 과 짝짓기
        data_withHdrsIdx = list(map(lambda y: list(map(lambda x: y[x], eff_hdrs_v)), data_calType_noneless))
        dict_ = list(map(lambda x: dict(zip(eff_hdrs_k, x)), data_withHdrsIdx))
        dicts_noneless = list(map(lambda y: dict(filter(lambda x: x[1]!=None, y.items())),dict_))
#        ## dict_Cal Type 입력처리
        targetColName = "Q'ty Cal Type Tag"
        dicts_finalNoneless = []
        for d in dicts_noneless:
            d["Q'ty Cal Type Tag"] = calcTypeName
            
            if "입력값" in d.keys():
                d["applyForCalc"] = d["입력값"]
                dicts_finalNoneless.append(d)
            elif paramName_lang in d.keys():
                d["applyForCalc"] = d[paramName_lang]
                dicts_finalNoneless.append(d)
            else:
                pass
        
        return {calcTypeName: dicts_finalNoneless}
        
    return map(setDict_OnEachCalType, datas_allCalType)
each_dict = get_DataOnRangesAtCatSheet(paramSheet)
dicts_AllInOne = {}
for d in each_dict:
    dict_k_v = d.items()
    for k,v in dict_k_v:
        dicts_AllInOne[k] = v
# Assign your output to the OUT variable.


OUT = dicts_AllInOne
# ----------------------------------------
물량param시트_약자_매개변수_정리 = Python(IN[0]=family_list_데이터_파싱_물량param_시트)  # CPython3
# ---------- 물량param시트_약자_매개변수_정리.python (32 lines) ----------
# Load the Python Standard and DesignScript Libraries
import sys
import clr
clr.AddReference('ProtoGeometry')
from Autodesk.DesignScript.Geometry import *

clr.AddReference("RevitNodes")
import Revit
from Revit.Elements import *

from functools import reduce
from functools import partial
from string import ascii_lowercase

# The inputs to this node will be stored as a list in the IN variables.
dataEnteringNode = IN
paramSheetDic = IN[0]
# Place your code below this line

def findDictPerCalType(dicList):
    dic = {}
    for i in dicList:
        dic[i["산출수식 약자"]] = i["applyForCalc"]
    
    return dic

ks_forDic = list(paramSheetDic.keys())
vs_forDic = list(map(findDictPerCalType, paramSheetDic.values()))

res = dict(zip(ks_forDic, vs_forDic))
# Assign your output to the OUT variable.
OUT = res
# ----------------------------------------
family_list_데이터_파싱_category_시트_2 = Python(IN[0]=importExcel, IN[1]=deconstruct.rest)  # CPython3
# ---------- family_list_데이터_파싱_category_시트_2.python (147 lines) ----------
# Load the Python Standard and DesignScript Libraries
import sys
import clr
clr.AddReference('ProtoGeometry')
from Autodesk.DesignScript.Geometry import *

from functools import reduce
from functools import partial
from string import ascii_lowercase

def getCharValue(s):
    # 베이스 케이스
    if not s:
        return 0
 
    value = 0
    # 입력 문자열을 대문자로 변환한 후 반복
    for ch in s:
        value = value * 26 + (ord(ch) - ord('A') + 1)
    return value
    
#################################Module For Functional Programing#############################################
curry = lambda f: lambda a,*args: f(a, *args) if (len(args)) else lambda *args: f(a, *args)

filter = curry(filter)
map = curry(map)

def _take(length, iter):
    res = []
    for a in iter:
        res.append(a)
        if len(res) == length:
            return res
        
take = curry(_take)
reduce = curry(reduce)

go = lambda *args: reduce(lambda a,f: f(a), args) ## 함수도 축약 가능 ##
##############################################################################################################
def find_IsInStr(target, str):
    if target == None or str == None:
        pass
    else:
        res = target in str
        return res

def find_range_by_columnItem(db, col_idx, sep_rule):
    tdb = list(map(lambda x: x[col_idx], db))
    last_idx_tdb = len(tdb)-1
    tdb_enum = enumerate(tdb)
    res = list(filter(lambda x: find_IsInStr(sep_rule, x[1]), tdb_enum))
    endidxs_tmp= list(map(lambda x: x[0]-1,res))
    #endidxs_tmp= list(map(lambda x: x[0],res))
    endidxs_tmp.pop(0)
    endidxs = endidxs_tmp + [last_idx_tdb]
    famTypeNames = list(map(lambda x: x[1],res))
    famTypeNamesIdxs = list(map(lambda x: x[0],res))
    rangeSttIdxs = list(map(lambda x: x[0]+1,res))
    rangeEndIdxs = endidxs
    result = dict(zip(famTypeNames, zip(famTypeNamesIdxs, zip(rangeSttIdxs,rangeEndIdxs))))
    return result

# The inputs to this node will be stored as a list in the IN variables.
dataEnteringNode = IN
db = IN[0]
allCatSheetsNames =IN[1]


paramSheet = db[0]
allCatSheets = db[1:]

# Place your code below this line

def find_headersAtCatSheet(catSheet):
    headers_CatSheet = map(lambda x: [x[1].replace("\n",""),x[0]], filter(lambda x: x[1] != None, enumerate(catSheet[1])))
    
    return dict(headers_CatSheet)

def find_rangesAtCatSheet(catSheet, hdrs_withIdx):
    return find_range_by_columnItem(catSheet, hdrs_withIdx["Family Type Name"], "H_")

def get_DataOnRangesAtCatSheet(catSheet): 
    hdrs_withIdx = find_headersAtCatSheet(catSheet)
    title_idx = map(lambda x: x[0], find_rangesAtCatSheet(catSheet, hdrs_withIdx).values())
    calcType_colDatas = list(map(lambda x: x[hdrs_withIdx["Q'ty Cal Type Tag"]], catSheet))
    calcTypes = list(map(lambda x: calcType_colDatas[x], title_idx))
    rgs_v = list(map(lambda x: x[1], find_rangesAtCatSheet(catSheet, hdrs_withIdx).values()))
    rgs_k = list(map(lambda x: x, find_rangesAtCatSheet(catSheet, hdrs_withIdx).keys()))
    
    hdrs_v = list(hdrs_withIdx.values())
    hdrs_k = list(hdrs_withIdx.keys())
    #tagDatas = list(zip(rgs_k,calcTypes))
    
    datas_allFamType = list(map(lambda x: list(zip(catSheet[x[0]-1:x[1]], range(x[0]-1,x[1]))), rgs_v))
    #datas_allFamType = list(zip(tagDatas, datas_allFamType_))
    
    def setDict_OnEachFamType(data_famType):  ## 최종적으로 산출식 없는 것 걸러내기 추가해야 함
        titleData = list(data_famType).pop(0)[0]
        
        famTypeName = titleData[hdrs_withIdx["Family Type Name"]]
        calcTypeName = titleData[hdrs_withIdx["Q'ty Cal Type Tag"]]
        data_famType_noneless = list(filter(lambda x: x[0][5] != None, data_famType))
        ## WM row 별 header명 과 짝짓기
        data_withHdrsIdx = list(map(lambda y: [list(map(lambda x: y[0][x], hdrs_v)), y[1]], data_famType_noneless))
        hdrs_k.append("rIDX")
        dict_ = list(map(lambda x: dict(zip(hdrs_k, x[0]+[x[1]])), data_withHdrsIdx))
        dicts_noneless = list(map(lambda y: dict(filter(lambda x: x[1]!=None, y.items())),dict_))
        ## dict_gauge, 물량산출식 없는 항목 처리
        dicts_final = []
        needDefault_ColName = "Gauge Code"
        noneRemove_ColName = "Dynamo 물량산출식"
        for d in dicts_noneless:
            d["Family Type Name"] = famTypeName
            
            if calcTypeName == None:
                pass            
            elif noneRemove_ColName in d.keys():
                d["Q'ty Cal Type Tag"] = calcTypeName
                d[needDefault_ColName] = ""
                dicts_final.append(d)

        
        return dicts_final
        
    dicts_allFamType = list(map(lambda x: setDict_OnEachFamType(list(x)), datas_allFamType))
    ds_famTypesAtCatSheet = dict(zip(rgs_k, dicts_allFamType))
    ds_famTypesAtCatSheet_effCalcType = dict(filter(lambda x: all(list(map(lambda i: "Q'ty Cal Type Tag" in i, x[1]))), list(ds_famTypesAtCatSheet.items())))
    ds_famTypesAtCatSheet_noneless = dict(filter(lambda x: len(list(x[1]))!=0, list(ds_famTypesAtCatSheet_effCalcType.items())))
    
    return  ds_famTypesAtCatSheet_noneless

## AllInOne 딕셔너리에 정리
dataOnRanges_allCat = list(map(get_DataOnRangesAtCatSheet, allCatSheets))
dataOnRanges_allCat_WithCatNames = list(zip(allCatSheetsNames, dataOnRanges_allCat))
dicts_AllInOne = {}

for d in dataOnRanges_allCat_WithCatNames:
    catName = d[0]
    dict_k_v = d[1].items()
    for k,v in dict_k_v:
        for wm in v:
            wm["SheetName"] = catName
        dicts_AllInOne[k] = v

# Assign your output to the OUT variable.
OUT = dicts_AllInOne
#OUT = get_DataOnRangesAtCatSheet(allCatSheets[0])#allCatSheetsWithNames#
# ----------------------------------------
family_list_데이터_파싱_category = Python(IN[0]=물량param시트_약자_매개변수_정리, IN[1]=family_list_데이터_파싱_category_시트_2)  # "Family List 데이터 파싱_Category - 물량Param 시트 결합"; CPython3
# ---------- family_list_데이터_파싱_category.python (46 lines) ----------
# Load the Python Standard and DesignScript Libraries
import sys
import clr
clr.AddReference('ProtoGeometry')
from Autodesk.DesignScript.Geometry import *

clr.AddReference("RevitNodes")
import Revit
from Revit.Elements import *

from functools import reduce
from functools import partial
from string import ascii_lowercase

# The inputs to this node will be stored as a list in the IN variables.
dataEnteringNode = IN
paramSheetDic = IN[0]
catSheetDic = IN[1]

# Place your code below this line
headers = list(catSheetDic.values())[0][0].Keys
wmspec_headers = list(filter(lambda x: "Work C" in x or "Spec" in x, headers))

def matchWith_paramDic(catSheetDic, paramSheetDic):
    res = {}
    for famType,diclist in catSheetDic.items():
        new_diclist = []
        for d in diclist:
            new_d = {}
            keys = d.Keys
            keys_new = set(keys) - set(wmspec_headers)
            calcType = d["Q'ty Cal Type Tag"]
            new_d["Sym_Val Dict"] = paramSheetDic[calcType]
            new_d["wmSpecs"] = list(map(lambda x: d[x],wmspec_headers))
            for spec in keys_new:
                new_d[spec] = d[spec]
            new_diclist.append(new_d)
        
        res[famType] = new_diclist
        
    return res
    

#res2 = map(lambda x: x[1], catSheetDic.items())
# Assign your output to the OUT variable.
OUT = matchWith_paramDic(catSheetDic, paramSheetDic)
# ----------------------------------------

# group: All Elements in Revit
all_elementsexceptrails = Python()  # CPython3; unwired: IN[0]
# ---------- all_elementsexceptrails.python (51 lines) ----------
# Load the Python Standard and DesignScript Libraries
import sys
import clr
clr.AddReference('ProtoGeometry')
from Autodesk.DesignScript.Geometry import *

clr.AddReference('RevitAPI')
from Autodesk.Revit.DB import *
import Autodesk

clr.AddReference('RevitServices')
import RevitServices
from RevitServices.Persistence import DocumentManager
doc = DocumentManager.Instance.CurrentDBDocument

def get_all_BIC():

    db = [
    Autodesk.Revit.DB.BuiltInCategory.OST_Floors,
    Autodesk.Revit.DB.BuiltInCategory.OST_Roofs,
    Autodesk.Revit.DB.BuiltInCategory.OST_Walls,
    Autodesk.Revit.DB.BuiltInCategory.OST_StructuralFoundation,
    Autodesk.Revit.DB.BuiltInCategory.OST_StructuralColumns,
    Autodesk.Revit.DB.BuiltInCategory.OST_StructuralFraming,
    Autodesk.Revit.DB.BuiltInCategory.OST_Ceilings,
    Autodesk.Revit.DB.BuiltInCategory.OST_Doors,
    Autodesk.Revit.DB.BuiltInCategory.OST_Windows,
    Autodesk.Revit.DB.BuiltInCategory.OST_Stairs,
    #Autodesk.Revit.DB.BuiltInCategory.OST_Railings,
    ]
    return db
    
def get_allElems(doc):
    bics = get_all_BIC()
    
    def getElems(x):
        collector = FilteredElementCollector(doc)
        res = collector.OfCategory(x).WhereElementIsNotElementType().ToElements()
        return res

    def getRailElems(x):
        collector = FilteredElementCollector(doc)
        res = collector.OfCategory(x).WhereElementIsNotElementType()
        return res

    res = map(getElems, bics)
#    res = getRailElems(Autodesk.Revit.DB.BuiltInCategory.OST_RailingSystemRail)
    return res


OUT = get_allElems(doc)
# ----------------------------------------
categories = Categories("OST_StairsRailing")
all_elements_of_category = ElementsOfCategory(Category=categories)
list_create = List.Create(item0=all_elements_of_category)
join = List.Join(list0=all_elementsexceptrails, list1=list_create)

# group: 임시필터링 구간 (패밀리 리스트에 없는 이름 제외)
flatten = List.Flatten(list=join)
code_block_10 = CodeBlock { "Type"; "Type Name"; }
getParameterValueByName = Element.GetParameterValueByName(element=flatten, parameterName=code_block_10.out0)
getParameterValueByName_2 = Element.GetParameterValueByName(element=getParameterValueByName, parameterName=code_block_10.out1)
code_block_11 = CodeBlock(i=getParameterValueByName_2) { i; }
code_block_12 = CodeBlock()
# ---------- code_block_12.designscript (13 lines) ----------
[
"H_SFRH_2400x3000x200",
"H_SFRH_2400x5600x200",
"FTS",
"360x",
"SS101",
"C150x",
"Pit Wall_UG_T150",
"Pit Slab T150",
"SHS-",
"구조 기초"
];
true;
# ----------------------------------------
contains = String.Contains(string=code_block_11@L1, searchFor=code_block_12.out0)
anyTrue = List.AnyTrue(list=contains@L2)
filterByBoolMask = List.FilterByBoolMask(list=flatten, mask=anyTrue)
code_block_13 = CodeBlock(filtered=filterByBoolMask.out) { filtered; }

# note: Revit에 있는 Family Type 항목만
filterByBoolMask_2 = List.FilterByBoolMask(list=getParameterValueByName, mask=anyTrue)
uniqueItems = List.UniqueItems(list=filterByBoolMask_2.out)

# group: Family Type 별 WM 코드 Revit 되먹임
code_block_14 = CodeBlock(catSheetDatas=family_list_데이터_파싱_category, UniqElemTypes=uniqueItems) { catSheetDatas; UniqElemTypes; }
code_block_15 = CodeBlock { "Type"; "Type Name"; }
getParameterValueByName_3 = Element.GetParameterValueByName(element=code_block_14.UniqElemTypes, parameterName=code_block_15.out1)
valueAtKey = DesignScript.Builtin.Dictionary.ValueAtKey(dictionary=code_block_14.catSheetDatas, key=getParameterValueByName_3)
byKeysValues = DesignScript.Builtin.Dictionary.ByKeysValues(keys=getParameterValueByName_3, values=valueAtKey)
code_block_16 = CodeBlock { "Q'ty Cal Type Tag"; }
get_WMCodesAndBriefSpec = Python(IN[0]=byKeysValues, IN[1]=code_block_16)  # CPython3
# ---------- get_WMCodesAndBriefSpec.python (33 lines) ----------
# Load the Python Standard and DesignScript Libraries
import sys
import clr
clr.AddReference('ProtoGeometry')
from Autodesk.DesignScript.Geometry import *

# The inputs to this node will be stored as a list in the IN variables.
dataEnteringNode = IN
dict_aio = IN[0]
calType_header = IN[1]
# Place your code below this line
famTypes = list(dict_aio.items())
res_dict = {}


def find_WMspecsPerFamType(k_v):
    k = k_v[0]
    wms = k_v[1]
    res = list(map(lambda x: [x["Work Master Code"]] + x["wmSpecs"], wms))
    res_zeroless = list(map(lambda y: filter(lambda x: x!=0, y), res))
    joined_strs = list(map(lambda x: ' | '.join(x),res_zeroless))

    return k,joined_strs

WMspecs = list(map(find_WMspecsPerFamType, famTypes))

for k,v in WMspecs:
    res_dict[k] = [dict_aio[k][0][calType_header]] + v



# Assign your output to the OUT variable.
OUT = res_dict
# ----------------------------------------
valueAtKey_2 = DesignScript.Builtin.Dictionary.ValueAtKey(dictionary=get_WMCodesAndBriefSpec, key=getParameterValueByName_3)
code_block_17 = CodeBlock()
# ---------- code_block_17.designscript (12 lines) ----------
[
"H_Q'ty Cal Type Tag",
"H_WM Code_1",
"H_WM Code_2",
"H_WM Code_3",
"H_WM Code_4",
"H_WM Code_5",
"H_WM Code_6",
"H_WM Code_7",
"H_WM Code_8",
"H_WM Code_9"
];
# ----------------------------------------
setParamElementTypes = Python(IN[0]=code_block_14.UniqElemTypes, IN[1]=valueAtKey_2, IN[2]=code_block_17)  # CPython3; frozen
# ---------- setParamElementTypes.python (36 lines) ----------
# Load the Python Standard and DesignScript Libraries
import sys
import clr
clr.AddReference('ProtoGeometry')
from Autodesk.DesignScript.Geometry import *

clr.AddReference("RevitNodes")
import Revit
from Revit.Elements import *

# The inputs to this node will be stored as a list in the IN variables.
dataEnteringNode = IN
elemTypes = IN[0]
WMs_perFamTyp = IN[1]
param_ListForWM = IN[2]

input_sets = list(zip(elemTypes, WMs_perFamTyp))

# Place your code below this line

def setParamAnElem(elem, paramNames, paramVals):
    effName_List = paramNames[:len(paramVals)]
    effVals_List = paramVals
    setForParam = list(zip(effName_List, effVals_List))
    res = list(map(lambda x: elem.SetParameterByName(x[0],x[1]), setForParam))
    
    return res


final = map(lambda x: setParamAnElem(x[0],param_ListForWM,x[1]), input_sets)


#res = elemT.GetParameterValueByName("Default Thickness")
# Assign your output to the OUT variable.
#OUT = input_sets
OUT = final
# ----------------------------------------

code_block_18 = CodeBlock(i=family_list_데이터_파싱_category) { i["H_SF_ACE_Mass_T2500"]; }
code_block_19 = CodeBlock()
# ---------- code_block_19.designscript (2 lines) ----------
//wm 딕셔너리 마다 시트명 포함하게 수정 필요
//(Family List 데이터 파싱_Category 시트)
# ----------------------------------------
family_list데이터_revit_부재_데이터_결합 = Python(IN[0]=family_list_데이터_파싱_category, IN[1]=code_block_13)  # "family list데이터 - Revit 부재 데이터 결합 & Sym_Val Dict 값 업데이트(타입,인스턴스 매개변수)"; CPython3
# ---------- family_list데이터_revit_부재_데이터_결합.python (68 lines) ----------
# Load the Python Standard and DesignScript Libraries
import sys
import clr

clr.AddReference('RevitAPI')
from Autodesk.Revit.DB import *
import Autodesk

#clr.AddReference('RevitNodes')
#import Revit
#clr.ImportExtensions(Revit.Elements)

clr.AddReference('RevitServices')
import RevitServices
from RevitServices.Persistence import DocumentManager
#doc = DocumentManager.Instance.CurrentDBDocument
#collector1 = FilteredElementCollector(doc)

clr.AddReference('ProtoGeometry')
from Autodesk.DesignScript.Geometry import *

from itertools import chain
from functools import reduce

# The inputs to this node will be stored as a list in the IN variables.
dataEnteringNode = IN
famlist_dic = IN[0]
revitElems = IN[1]

# Place your code below this line
def matchWith_Elem_Dict(famlist_dic,revitElems):
    res = []
    for i in revitElems:
        tmp = {}
        famTypeName = i.GetParameterValueByName("Type").GetParameterValueByName("Type Name")
        tmp["Elem"] = i
        tmp["wms"] = famlist_dic[famTypeName]
        
        res.append(tmp)
    return res

def update_sym_valDict(elemDicts):
    for d in elemDicts:
        elem = d["Elem"]
        wms = d["wms"]
        
        for wm in wms:
            sym_valDict = wm["Sym_Val Dict"]
            sv_keys = sym_valDict.Keys
            sv_vals = sym_valDict.Values
            sv_items = list(zip(sv_keys, sv_vals))
            
            for x in sv_items:
                [k,v] = x
                if isinstance(v, str):
                    if v == "Level":
                        #sym_valDict[k] = type(UnwrapElement(elem.GetParameterValueByName(v)))
                        sym_valDict[k] = round(elem.GetParameterValueByName("Elevation at Bottom"),2)
                    elif elem.GetParameterValueByName(v):
                        sym_valDict[k] = elem.GetParameterValueByName(v)
                    elif elem.GetParameterValueByName("Type").GetParameterValueByName(v):
                        sym_valDict[k] = elem.GetParameterValueByName("Type").GetParameterValueByName(v)
                    else:
                        pass
    return elemDicts

# Assign your output to the OUT variable.
OUT = update_sym_valDict(matchWith_Elem_Dict(famlist_dic,revitElems))
# ----------------------------------------
watch = Watch(family_list데이터_revit_부재_데이터_결합)

# group: 디버깅용
code_block_20 = CodeBlock(i=join) { i[3][180]; }
python_script = Python(IN[0]=code_block_20)  # CPython3
# ---------- python_script.python (14 lines) ----------
# Load the Python Standard and DesignScript Libraries
import sys
import clr
clr.AddReference('ProtoGeometry')
from Autodesk.DesignScript.Geometry import *

# The inputs to this node will be stored as a list in the IN variables.
dataEnteringNode = IN
#e = UnwrapElement(IN[0])
e = IN[0]
# Place your code below this line
res = e.GetParameterValueByName("Level").GetParameterValueByName("Elevation")
# Assign your output to the OUT variable.
OUT = res
# ----------------------------------------
parameters = Element.Parameters(element=code_block_20)
code_block_21 = CodeBlock { "Level"; "Elevation at Bottom"; }
getParameterValueByName_4 = Element.GetParameterValueByName(element=code_block_20, parameterName=code_block_21.out0)
getParameterValueByName_5 = Element.GetParameterValueByName(element=code_block_20, parameterName=code_block_21.out1)

# note: UG RC Union 준비(UG 부재 전체 형상 유니온 - PIT, Trench는 내부공동 포함하는 Boundary로)
# excavation 개별 형상 리스트
# 하나 꺼내서
#  남은 나머지들 합쳐서 디퍼런스로 남기고 (기초별 유효 excavation 형상)
# 	UG RC Union이랑 디퍼런스 하면 백필
# 	UG RC Union이랑 인터섹트 하면 디스포잘
토공_산출_구간 = Python(IN[0]=family_list데이터_revit_부재_데이터_결합)  # CPython3
# ---------- 토공_산출_구간.python (208 lines) ----------
# Load the Python Standard and DesignScript Libraries
import sys
import clr

clr.AddReference('RevitAPI')
from Autodesk.Revit.DB import *
import Autodesk

clr.AddReference('RevitNodes')
import Revit
clr.ImportExtensions(Revit.Elements)

clr.AddReference('RevitServices')
import RevitServices
from RevitServices.Persistence import DocumentManager
#doc = DocumentManager.Instance.CurrentDBDocument
#collector1 = FilteredElementCollector(doc)

clr.AddReference('ProtoGeometry')
from Autodesk.DesignScript.Geometry import *

from itertools import chain
from functools import reduce
import copy
###################################################################################################
curry = lambda f: lambda a,*args: f(a, *args) if (len(args)) else lambda *args: f(a, *args)

add = curry(lambda a,b: a + b)

filter = curry(filter)
map = curry(map)

def _take(length, iter):
    res = []
    for a in iter:
        res.append(a)
        if len(res) == length:
            return res
take = curry(_take)
reduce = curry(reduce)

go = lambda *args: reduce(lambda a,f: f(a), args) ## 함수도 축약 가능 ##
###########################################
# The inputs to this node will be stored as a list in the IN variables.
dataEnteringNode = IN
elemDicts = IN[0]


#all_UG_RC_Elems = []
#for dic in elemDicts:
    

# Place your code below this line


def makeExcaShape(elem, sym_valDict):
    def findBtmCrv(geo, sym_valDict): ##btmOffset = d1 + d2
        offSetDist = sym_valDict["D1"] + sym_valDict["D2"]
        #H2 = sym_valDict["H2"] if sym_valDict["H2"]>=0 else -sym_valDict["H2"]
        h = abs(sym_valDict["C1"] + sym_valDict["C2"] + sym_valDict["C3"])
        bdBox_fdn = BoundingBox.ByGeometry(geo).ToCuboid() ## 형상의 자그마한 요철 무시
        srfs = bdBox_fdn.Explode() ## surface들
        btmSrf = PolySurface.ByJoinedSurfaces(list(filter(lambda x: round(x.NormalAtParameter(0.5,0.5).Z, 3) == -1, srfs)))
        btmCrvs = btmSrf.PerimeterCurves()
        btmPolCrv = PolyCurve.ByJoinedCurves(btmCrvs)
        offseted_btmPolCrv = btmPolCrv.Offset(offSetDist)
        h_modified_btmPolCrv = offseted_btmPolCrv.Translate(0,0,-h-0.3)
        return h_modified_btmPolCrv
    
    def findUprCrv(_btmPolCrv, sym_valDict):
        btmCrvZ = _btmPolCrv.StartPoint.Z
        test = (sym_valDict["C1"] + sym_valDict["C2"] + sym_valDict["C3"])
        #H = abs(sym_valDict["H2"]) + (sym_valDict["C1"] + sym_valDict["C2"] + sym_valDict["C3"])
        H = abs(round(btmCrvZ,2))
        G = sym_valDict["G"]
        offSetDist = (G * H)
        
        uprPolCrv = _btmPolCrv.Translate(0,0,H).Offset(offSetDist)
        uprCrvZ = uprPolCrv.StartPoint.Z
        return uprPolCrv#_btmPolCrv,btmCrvZ,uprPolCrv,uprCrvZ #btmCrvZ,uprCrvZ,test


    fdnsGeo = elem.Geometry()[0]
    btmPolCrv = findBtmCrv(fdnsGeo, sym_valDict)
    uprPolCrv = findUprCrv(btmPolCrv, sym_valDict)
    
    return Solid.ByLoft([btmPolCrv,uprPolCrv])


#def addExcaInElemDicts(elemDicts):
#    allExcas = []
#    for idx,dic in enumerate(elemDicts):
#        elem = dic["Elem"]
#        wms = dic["wms"]
#        excaBln = "Exca" in "".join(list(map(lambda x: x["Dynamo 물량산출식"], wms)))
#        if excaBln:
#            sym_valDict = wms[0]["Sym_Val Dict"]
#            excaGeo = makeExcaShape(elem, sym_valDict)
#            allExcas.append([idx, excaGeo])
#            dic["ExcaGeo"] = [idx, excaGeo]
#
#    return (allExcas,elemDicts)
    
def addExcaInElemDicts(elemDicts):
    allExcas = []
    for idx,dic in enumerate(elemDicts):
        elem = dic["Elem"]
        wms = dic["wms"]
        excaBln = "Exca" in "".join(list(map(lambda x: x["Dynamo 물량산출식"], wms)))
        if excaBln:
            sym_valDict = wms[0]["Sym_Val Dict"]
            excaGeo = makeExcaShape(elem, sym_valDict)
            try:
                allExcasUni = Solid.ByUnion(allExcas)
                eff_excaGeo = excaGeo.Split(allExcasUni)[0]
                allExcas.append(excaGeo)
            except:
                eff_excaGeo = excaGeo
                allExcas.append(excaGeo)
            dic["ExcaGeo"] = eff_excaGeo

    return elemDicts


def find_allGeo_UG_elems(elemDicts):
    geoResult = []
    for dic in elemDicts:
        elem = dic["Elem"]
        wms = dic["wms"]
        excaBln = "Exca" in "".join(list(map(lambda x: x["Dynamo 물량산출식"], wms)))
        famType_ = wms[0]["Family Type Name"]
            
        if "MAT_" in famType_ or "Mass_" in famType_ or "Pit" in famType_ or "Trench" in famType_:
            if "Slab" in famType_ or "MAT_" in famType_ or "Mass_" in famType_ :
                srfs = elem.Geometry()[0].Explode() ## surface들
                btmSrf = PolySurface.ByJoinedSurfaces(list(filter(lambda x: round(x.NormalAtParameter(0.5,0.5).Z, 3) == -1, srfs)))
                btmCrvs = btmSrf.PerimeterCurves()
                btmPolCrv = PolyCurve.ByJoinedCurves(btmCrvs)
                btmCrvZ = btmPolCrv.StartPoint.Z
                uprPolCrv = btmPolCrv.Translate(0,0,(0-btmCrvZ))
                targetGeo = Solid.ByLoft([btmPolCrv,uprPolCrv])
                geoResult.append(targetGeo)
            else:
                geoResult.append(elem.Geometry()[0])
        elif "PED_" in famType_ or "TG_" in famType_ or "SOG_" in famType_ or "UG" in famType_:
            geoResult.append(elem.Geometry()[0])
            pass
        elif excaBln:
            geoResult.append(elem.Geometry()[0])
            pass

    return geoResult

#allGeo_UG_RC_Elems = find_allGeo_UG_elems(elemDicts)
#allUniGeo_UG_RC_Elems = Solid.ByUnion(allGeo_UG_RC_Elems)



#elemDicts_ExcasWithWholeExcaList = addExcaInElemDicts(elemDicts)

#elemDicts_effExcas = []

def add_effExcaInElemDicts(elemDicts):
    
    allGeo_UG_RC_Elems = find_allGeo_UG_elems(elemDicts)
    allUniGeo_UG_RC_Elems = Solid.ByUnion(allGeo_UG_RC_Elems)
    #elemDicts_ExcasWithWholeExcaList = addExcaInElemDicts(elemDicts)
    #wholeExcaList = elemDicts_ExcasWithWholeExcaList[0]
    
    #elemDicts_excas = elemDicts_ExcasWithWholeExcaList[1]
    elemDicts_excas = addExcaInElemDicts(elemDicts)
    
    for dic in elemDicts_excas:
        if "ExcaGeo" in dic.keys():
            excaGeo = dic["ExcaGeo"]
#            eff_excaRef = []
#            for excaRef in wholeExcaList:
#                if excaGeo[0] != excaRef[0]:
#                    eff_excaRef.append(excaRef[1])
#                
#            uni_eff_excaRef = Solid.ByUnion(eff_excaRef)
            
            #eff_excaGeo = excaGeo[1].Split(uni_eff_excaRef)[0]
            eff_excaGeo = excaGeo
            dic["effExcaGeo"] = eff_excaGeo
            dic["effBackfillGeo"] = eff_excaGeo.Split(allUniGeo_UG_RC_Elems)[0]
            dic["effDisposalGeo"] = eff_excaGeo.Intersect(allUniGeo_UG_RC_Elems)
        
        wms = dic["wms"]
        for wm in wms:
            if "Exca" in wm["Dynamo 물량산출식"] or\
               "Back" in wm["Dynamo 물량산출식"] or\
               "Disp" in wm["Dynamo 물량산출식"]:
                wm["Sym_Val Dict"]["Exca"] = dic["effExcaGeo"].Volume
                wm["Sym_Val Dict"]["Back"] = dic["effBackfillGeo"].Volume

                try:
                    wm["Sym_Val Dict"]["Disp"] = dic["effDisposalGeo"][0].Volume
                except:
                    wm["Sym_Val Dict"]["Disp"] = 0


    return elemDicts_excas


# Assign your output to the OUT variable.
OUT = add_effExcaInElemDicts(elemDicts)#elemDicts_ExcasWithWholeExcaList
#OUT = allUniGeo_UG_RC_Elems
# ----------------------------------------
code_block_22 = CodeBlock(i=토공_산출_구간) { i; i[1]; }

# group: 디버깅용 데이터 확인 구간
number_slider = DoubleSlider(1, range=0..38 step 1)
code_block_23 = CodeBlock(i=토공_산출_구간, j=number_slider) { i[j]; }  # frozen
code_block_24 = CodeBlock(i=code_block_23) { i[1][1]; }
code_block_25 = CodeBlock(i=code_block_22.i)
# ---------- code_block_25.designscript (3 lines) ----------
i["wms"]["Q'ty Cal Type Tag"]=="SF-Q2";
i["wms"]["Dynamo 물량산출식"]=="=Exca";
i["wms"]["Family Type Name"]=="H_SF_ACE_Mass_T2500";
# ----------------------------------------
anyTrue_2 = List.AnyTrue(list=code_block_25.out1@L2)
filterByBoolMask_3 = List.FilterByBoolMask(list=code_block_22.i, mask=anyTrue_2)
code_block_26 = CodeBlock(iiiiiiiiiiiiiiiiiiiiiiiiiiiiiiiiiiiiiiiiiiiiiiiiiiiiiiiiiiiiiiiiiiiiiiiiiiiiiiiii=filterByBoolMask_3.in) { iiiiiiiiiiiiiiiiiiiiiiiiiiiiiiiiiiiiiiiiiiiiiiiiiiiiiiiiiiiiiiiiiiiiiiiiiiiiiiiii; }

code_block_27 = CodeBlock(i=code_block_26) { i[2]["effBackfillGeo"]; }
code_block_28 = CodeBlock(i=code_block_26) { i[2]["effDisposalGeo"]; }
code_block_29 = CodeBlock(i=code_block_26) { i[2]["effExcaGeo"]; }
code_block_30 = CodeBlock(i=code_block_26) { i["wms"]; }
# note: Sym Val Dict에서
# 산출식에 사용된 것 이외를
# 제거하기
wm_별_산식에_의한_최종_계산 = Python(IN[0]=토공_산출_구간)  # CPython3
# ---------- wm_별_산식에_의한_최종_계산.python (91 lines) ----------
# Load the Python Standard and DesignScript Libraries
import sys
import clr

clr.AddReference('RevitAPI')
from Autodesk.Revit.DB import *
import Autodesk

clr.AddReference('RevitNodes')
import Revit
clr.ImportExtensions(Revit.Elements)

clr.AddReference('RevitServices')
import RevitServices
from RevitServices.Persistence import DocumentManager
#doc = DocumentManager.Instance.CurrentDBDocument
#collector1 = FilteredElementCollector(doc)

clr.AddReference('ProtoGeometry')
from Autodesk.DesignScript.Geometry import *

from itertools import chain
from functools import reduce
import copy
###################################################################################################
curry = lambda f: lambda a,*args: f(a, *args) if (len(args)) else lambda *args: f(a, *args)

add = curry(lambda a,b: a + b)

filter = curry(filter)
map = curry(map)

def _take(length, iter):
    res = []
    for a in iter:
        res.append(a)
        if len(res) == length:
            return res
take = curry(_take)
reduce = curry(reduce)

go = lambda *args: reduce(lambda a,f: f(a), args) ## 함수도 축약 가능 ##
###########################################
# The inputs to this node will be stored as a list in the IN variables.
dataEnteringNode = IN
elemDicts = IN[0]

def clean_SymValDict(elemDicts):
    for dic in elemDicts:
        wms = dic["wms"]
        for wm in wms:
            formula = wm["Dynamo 물량산출식"]
            SymValDicts = wm["Sym_Val Dict"]
            SymValItems = list(zip(SymValDicts.Keys, SymValDicts.Values))
            sym_val_keySets = []
            sym_val_valSets = []
            for k,v in SymValItems:
                if k in formula:
                    sym_val_keySets.append(k)
                    sym_val_valSets.append(v)
            #wm["Sym_Val Set"] = [sym_val_keySets,sym_val_valSets]
            wm["Sym_Val Set"] = dict(zip(sym_val_keySets,sym_val_valSets))
            formula_eqSymRemove = formula.lstrip("=")
            tmp = formula_eqSymRemove
            for k in sym_val_keySets: ## 이 부분은 좀더 범용 처리 필요할수도
                priorSymList = ["Exca", "Back", "Disp"]
                #any(list(map(lambda x: x in tmp, priorList)))
                #if "Exca" in tmp or "Back" in tmp or "Disp" in tmp:
                if any(list(map(lambda x: x in tmp, priorSymList))):
                    appliedSym = list(filter(lambda x: x in tmp, priorSymList))[0]
                    #if len(k) > 1:
                    if k == appliedSym:
                        tmp = tmp.replace(k, str(wm["Sym_Val Set"][k]))
                else:
                    tmp = tmp.replace(k, str(wm["Sym_Val Set"][k]))
                
            
            #wm["calcResult"] = tmp.strip()
            wm["calcResult"] = round(eval(tmp.strip()),3)
    
    return elemDicts

# Place your code below this line

elemDicts_withSymValSet = clean_SymValDict(elemDicts)




# Assign your output to the OUT variable.
OUT = clean_SymValDict(elemDicts)
# ----------------------------------------

# group: 디버깅용 데이터 확인 구간
code_block_31 = CodeBlock(i=wm_별_산식에_의한_최종_계산) { i["wms"]; }
code_block_32 = CodeBlock(i=code_block_31) { i["Dynamo 물량산출식"]; }
code_block_33 = CodeBlock { "="; }
split = String.Split(string=code_block_32, separator0=code_block_33)
flatten_2 = List.Flatten(list=split)
count = List.Count(list=code_block_32@L2)
chop = List.Chop(list=flatten_2, lengths=count)
code_block_34 = CodeBlock(i=code_block_31) { i["Sym_Val Set"]; }
firstItem = List.FirstItem(list=code_block_34@L3)
chop_2 = List.Chop(list=firstItem, lengths=count)
toLower = String.ToLower(string=chop_2)
lastItem = List.LastItem(list=code_block_34@L3)
chop_3 = List.Chop(list=lastItem, lengths=count)
evaluateFormula_2 = Math.EvaluateFormula(formulaString=chop, parameters=toLower, arguments=chop_3)
code_block_35 = CodeBlock(i=chop) { i[0]; }
code_block_36 = CodeBlock(i=code_block_35) { i[0]; }
code_block_37 = CodeBlock(i=chop_2) { i[0]; }
code_block_38 = CodeBlock(i=code_block_37) { i[0]; }
code_block_39 = CodeBlock(i=chop_3) { i[0]; }
code_block_40 = CodeBlock(i=code_block_39) { i[0]; }

# group: 디버깅용 데이터 확인 구간
code_block_41 = CodeBlock(i=code_block_22.i)
# ---------- code_block_41.designscript (3 lines) ----------
i["wms"]["Q'ty Cal Type Tag"]=="SF-Q2";
i["wms"]["Dynamo 물량산출식"]=="=Exca";
i["wms"]["Family Type Name"]=="H_SB_ACB_TG_B400xH600";
# ----------------------------------------
anyTrue_3 = List.AnyTrue(list=code_block_41.out2@L2)
filterByBoolMask_4 = List.FilterByBoolMask(list=code_block_22.i, mask=anyTrue_3)
code_block_42 = CodeBlock(iiiiiiiiiiiiiiiiiiiiiiiiiiiiiiiiiiiiiiiiiiiiiiiiiiiiiiiiiiiiiiiiiiiiiiiiiiiiiiiii=filterByBoolMask_4.in) { iiiiiiiiiiiiiiiiiiiiiiiiiiiiiiiiiiiiiiiiiiiiiiiiiiiiiiiiiiiiiiiiiiiiiiiiiiiiiiiii; }
number_slider_2 = DoubleSlider(1, range=0..38 step 1)
code_block_43 = CodeBlock(i=토공_산출_구간, j=number_slider_2) { i[j]; }  # frozen
code_block_44 = CodeBlock(i=code_block_43) { i[1][1]; }

exportToExcel = Data.ExportToExcel()  # unwired: filePath, sheetName, startRow, startColumn, data
eval_test = Python()  # CPython3; unwired: IN[0]
# ---------- eval_test.python (39 lines) ----------
# Load the Python Standard and DesignScript Libraries
import sys
import clr

clr.AddReference('RevitAPI')
from Autodesk.Revit.DB import *
import Autodesk

#import Autodesk.Revit.DB.

clr.AddReference('RevitNodes')
import Revit
clr.ImportExtensions(Revit.Elements)

clr.AddReference('RevitServices')
import RevitServices
from RevitServices.Persistence import DocumentManager
#doc = DocumentManager.Instance.CurrentDBDocument
#collector1 = FilteredElementCollector(doc)

clr.AddReference('ProtoGeometry')
from Autodesk.DesignScript.Geometry import *

from itertools import chain
from functools import reduce
import copy

# The inputs to this node will be stored as a list in the IN variables.
dataEnteringNode = IN

# Place your code below this line
myDict = {"A": 1, "B": 2}
strFormula = "A + B"

str1 = strFormula.replace("A", str(myDict["A"]))
str2 = str1.replace("B", str(myDict["B"]))
#Math.EvaluateFormula
# Assign your output to the OUT variable.
OUT = "b" in "Back"
# ----------------------------------------
code_block_45 = CodeBlock(i=code_block_31) { i["calcResult"]; }
code_block_46 = CodeBlock(i=code_block_31) { i[432]; }
code_block_47 = CodeBlock(i=wm_별_산식에_의한_최종_계산) { [i["wms"]["rIDX"], i["wms"]["calcResult"]]; [i["wms"]["SheetName"], i["wms"]["rIDX"], i["wms"]["calcResult"]]; }
transpose = List.Transpose(lists=code_block_47.out1)
code_block_48 = CodeBlock(i=wm_별_산식에_의한_최종_계산) { i["wms"]["effExcaGeo"]; }
