# Dynamo graph forStair_test.dyn (Dynamo 2.16.1.2727)

categories = Categories("OST_Stairs")
all_elements_of_category = ElementsOfCategory(Category=categories)
parameters = Element.Parameters(element=all_elements_of_category)
categories_2 = Categories("OST_StairsPaths")
all_elements_of_category_2 = ElementsOfCategory(Category=categories_2)
parameters_2 = Element.Parameters()  # unwired: element
categories_3 = Categories("OST_StairsRuns")
all_elements_of_category_3 = ElementsOfCategory(Category=categories_3)
geometry = Element.Geometry(element=all_elements_of_category_3)
code_block = CodeBlock(i=geometry) { i[0][0]; }
explode = Geometry.Explode(geometry=code_block)
perimeterCurves = Surface.PerimeterCurves(surface=explode)
code_block_2 = CodeBlock(i=perimeterCurves) { i[0]; }
length = Curve.Length(curve=code_block_2)
maximumItem = List.MaximumItem(list=length)
categories_4 = Categories("OST_StairsLandings")
all_elements_of_category_4 = ElementsOfCategory(Category=categories_4)
geometry_2 = Element.Geometry(element=all_elements_of_category_4)
code_block_3 = CodeBlock(i=geometry_2) { i[1]; }
explode_2 = Geometry.Explode(geometry=code_block_3)
code_block_4 = CodeBlock { 0.5; }
normalAtParameter = Surface.NormalAtParameter(surface=explode_2, u=code_block_4, v=code_block_4)
Z = Vector.Z(vector=normalAtParameter)
code_block_5 = CodeBlock(x=Z) { x == 1? true:false; }
filterByBoolMask = List.FilterByBoolMask(list=explode_2, mask=code_block_5)
code_block_6 = CodeBlock(i=filterByBoolMask.in) { i; }
code_block_7 = CodeBlock(i=code_block_6) { i[0]; }
perimeterCurves_2 = Surface.PerimeterCurves(surface=code_block_7)
code_block_8 = CodeBlock(i=code_block_3) { i[1]; }
volume = Solid.Volume(solid=code_block_8)
area = Surface.Area(surface=code_block_7)
code_block_9 = CodeBlock(v=volume, a=area) { v/a; }
categories_5 = Categories("OST_Stairs")
all_elements_of_category_5 = ElementsOfCategory(Category=categories_5)
code_block_10 = CodeBlock(i=all_elements_of_category) { i[1]; }
parameters_3 = Element.Parameters(element=code_block_10)
code_block_11 = CodeBlock { "Family"; "Family and Type"; }
getParameterValueByName = Element.GetParameterValueByName(element=code_block_10, parameterName=code_block_11.out0)
name = Element.Name(element=getParameterValueByName)
getParameterValueByName_2 = Element.GetParameterValueByName(element=code_block_10, parameterName=code_block_11.out1)
name_2 = Element.Name(element=getParameterValueByName_2)
parameters_4 = Element.Parameters(element=getParameterValueByName_2)
code_block_12 = CodeBlock { "Left Support Type"; "Right Support Type"; }
getParameterValueByName_3 = Element.GetParameterValueByName(element=getParameterValueByName_2, parameterName=code_block_12.out0)
name_3 = Element.Name(element=getParameterValueByName_3)
parameters_5 = Element.Parameters(element=getParameterValueByName_3)
code_block_13 = CodeBlock { "Section Profile"; "Right Support Type"; }
getParameterValueByName_4 = Element.GetParameterValueByName(element=getParameterValueByName_3, parameterName=code_block_13.out0)
parameters_6 = Element.Parameters(element=getParameterValueByName_4)
