# Dynamo graph 230824_수량산출_Rev1.0.dyn (Dynamo 2.13.1.3887)

# group: Select Excel
file_path_excel_파일_선택 = Filename(".\플랜트건축팀_BIM_팀 표준 Family List_Rev.0_SQ1_20230824.xlsx")  # graph input
file_from_path = FileObject(path=file_path_excel_파일_선택)

# group: Excel 시트 이름 불러오기 Test용
python_script_get_all_sheet_name = Python(IN[0]=file_path_excel_파일_선택)  # CPython3
# ---------- python_script_get_all_sheet_name.python (42 lines) ----------
import sys
import clr

clr.AddReference("RevitAPI")
clr.AddReference("RevitAPIUI")

from System import Environment

import re

clr.AddReference('Microsoft.Office.Interop.Excel, Version=11.0.0.0, Culture=neutral, PublicKeyToken=71e9bce111e9429c')
from Microsoft.Office.Interop import Excel
from System.Runtime.InteropServices import Marshal

filepath = IN[0]

ex = Excel.ApplicationClass()
ex.Visible = False 
workbook = Excel.Workbooks(ex.Workbooks).Open(filepath)
all_Sheets = Excel.Sheets(workbook.Worksheets)
all_sheets_name = [Excel.Worksheet(ws).get_Name() for ws in all_Sheets]
#
allworkbooks = Excel.Workbooks(ex.Workbooks)
allworkbooks.Close()
ex.Quit()

if workbook is not None:
    Marshal.ReleaseComObject(workbook)
if ex is not None:
    Marshal.ReleaseComObject(ex)
workbook = None
ex = None

# Define a regular expression pattern
pattern = r"^\d+\."

# Extract strings that match the pattern
result_list = [s for s in all_sheets_name if re.match(pattern, s)]



OUT = result_list
# ----------------------------------------
code_block = CodeBlock(a=python_script_get_all_sheet_name) { a[0..4]; }
clean = List.Clean(list=code_block)
string_시트명_입력 = StringInput("1.Floors")  # graph input
string_시트명_입력_2 = StringInput("4.St Fdn")  # graph input
join = List.Join(list0=string_시트명_입력, list1=string_시트명_입력_2)

# group: Excel : 카테고리 별 데이터 분류
# C열 = family 기준으로 데이터 분할 > D열 = 입력 and E열 = 입력 기준 필터링
importExcel = Data.ImportExcel(file=file_from_path, sheetName=clean)
number = DoubleInput(1)
getItemAtIndex = List.GetItemAtIndex(list=importExcel@L3, index=number)
string_from_object = FromObject(object=getItemAtIndex)
boolean = BoolSelector(true)
number_2 = DoubleInput(5)
dropItems = List.DropItems(list=importExcel@L3, amount=number_2)
transpose = List.Transpose(lists=dropItems@L3)
string = StringInput("category")
contains = String.Contains(string=string_from_object, searchFor=string, ignoreCase=boolean)
indexOf = List.IndexOf(list=contains, element=boolean, lacing=CrossProduct)
getItemAtIndex_2 = List.GetItemAtIndex(list=transpose@L3, index=indexOf, lacing=Shortest)
string_from_object_2 = FromObject(object=getItemAtIndex_2)
string_2 = StringInput("family")
boolean_2 = BoolSelector(true)
contains_2 = String.Contains(string=string_from_object_2, searchFor=string_2, ignoreCase=boolean_2)
allIndicesOf = List.AllIndicesOf(list=contains_2, item=boolean_2, lacing=CrossProduct)
join_2 = List.Join()  # unwired: list0, list1
count = List.Count(list=contains_2@L2)
code_block_2 = CodeBlock(n=count) { n-1; }
combine = List.Combine(combineFunction=join_2, list0=allIndicesOf, list1=code_block_2)
restOfItems = List.RestOfItems(list=combine@L2)
code_block_3 = CodeBlock(a=allIndicesOf, b=restOfItems) { a..b-1; }
string_3 = StringInput("type tag")
contains_3 = String.Contains(string=string_from_object, searchFor=string_3, ignoreCase=boolean)
indexOf_2 = List.IndexOf(list=contains_3, element=boolean, lacing=CrossProduct)
getItemAtIndex_3 = List.GetItemAtIndex(list=transpose@L3, index=indexOf_2, lacing=Shortest)
getItemAtIndex_4 = List.GetItemAtIndex(list=getItemAtIndex_3, index=allIndicesOf, lacing=Shortest)
isNull = Object.IsNull(object=getItemAtIndex_4, lacing=CrossProduct)
string_4 = StringInput("building")
contains_4 = String.Contains(string=string_from_object, searchFor=string_4, ignoreCase=boolean)
indexOf_3 = List.IndexOf(list=contains_4, element=boolean, lacing=CrossProduct)
getItemAtIndex_5 = List.GetItemAtIndex(list=transpose@L3, index=indexOf_3, lacing=Shortest)
getItemAtIndex_6 = List.GetItemAtIndex(list=getItemAtIndex_5, index=allIndicesOf, lacing=Shortest)
isNull_2 = Object.IsNull(object=getItemAtIndex_6, lacing=CrossProduct)
formula = Formula("if(a=false and b=false, true, false)", a=isNull, b=isNull_2)
boolean_3 = BoolSelector(true)
allIndicesOf_2 = List.AllIndicesOf(list=formula, item=boolean_3, lacing=CrossProduct)
string_5 = StringInput("family type name")
contains_5 = String.Contains(string=string_from_object, searchFor=string_5, ignoreCase=boolean)
indexOf_4 = List.IndexOf(list=contains_5, element=boolean, lacing=CrossProduct)
getItemAtIndex_7 = List.GetItemAtIndex(list=transpose@L3, index=indexOf_4, lacing=Shortest)
getItemAtIndex_8 = List.GetItemAtIndex(list=getItemAtIndex_7, index=allIndicesOf, lacing=Shortest)
list_getitematindex_패밀리명_추출 = List.GetItemAtIndex(list=getItemAtIndex_8, index=allIndicesOf_2, lacing=Shortest)
string_6 = StringInput("물량산출식")
contains_6 = String.Contains(string=string_from_object, searchFor=string_6, ignoreCase=boolean)
indexOf_5 = List.IndexOf(list=contains_6, element=boolean, lacing=CrossProduct)
getItemAtIndex_9 = List.GetItemAtIndex(list=transpose@L3, index=indexOf_5, lacing=Shortest)
getItemAtIndex_10 = List.GetItemAtIndex(list=code_block_3, index=allIndicesOf_2, lacing=Shortest)
getItemAtIndex_11 = List.GetItemAtIndex(list=getItemAtIndex_9, index=getItemAtIndex_10, lacing=Shortest)
isNull_3 = Object.IsNull(object=getItemAtIndex_11)
boolean_4 = BoolSelector(false)
allIndicesOf_3 = List.AllIndicesOf(list=isNull_3@@L2, item=boolean_4, lacing=CrossProduct)
watch = Watch(allIndicesOf_3)
boolean_5 = BoolSelector(false)
clean_2 = List.Clean(list=getItemAtIndex_11, preserveIndices=boolean_5)
python_script_공백과_제거_패밀리_별_수식 = Python(IN[0]=clean_2)  # CPython3
# ---------- python_script_공백과_제거_패밀리_별_수식.python (29 lines) ----------
import clr
clr.AddReference("RevitAPI")
clr.AddReference("RevitAPIUI")

from Autodesk.Revit.DB import FilteredElementCollector, BuiltInCategory, Transaction, ElementId
from Autodesk.Revit.DB import Transaction

formula = IN[0]
output = []
output1 = []
output2 = []

def replace_special_characters_in_parameter(parameter, replacement_word):
    # 특수문자를 replacement_word로 교체 후 반환
    special_characters = "=_ "
    for char in special_characters:
        parameter = parameter.replace(char, replacement_word)
    return parameter

def remove_word_from_list(input_list, word_to_remove):
    return [word for word in input_list if word != word_to_remove]

# 요소들의 특정 파라미터에서 특수문자 제거
for i in range(len(formula)):
    for j in range(len(formula[i])):
        for k in range(len(formula[i][j])):
            formula[i][j][k] = replace_special_characters_in_parameter(formula[i][j][k], '')
    
OUT = formula
# ----------------------------------------
getItemAtIndex_12 = List.GetItemAtIndex(list=getItemAtIndex_4, index=allIndicesOf_2, lacing=Shortest)

# group: 모든 카테고리 종류 선택
categories = Categories("OST_StructuralColumns")
categories_2 = Categories("OST_StructuralFoundation")
categories_3 = Categories("OST_StructuralFraming")
categories_4 = Categories("OST_Walls")
categories_5 = Categories("OST_Roofs")
categories_6 = Categories("OST_Floors")
categories_7 = Categories("OST_Ceilings")
join_3 = List.Join(list0=categories, list1=categories_2, list2=categories_3, list3=categories_4, list4=categories_5, list5=categories_6, list6=categories_7)

# group: 객체 필터
all_elements_of_category = ElementsOfCategory(Category=join_3)
flatten = List.Flatten(list=all_elements_of_category)
name = Element.Name(element=flatten)

# group: Excel == Revit Family 매칭하여 필터
python_script_엑셀_revit_패밀리_매칭 = Python(IN[0]=name, IN[1]=list_getitematindex_패밀리명_추출)  # "Python Script : 엑셀 == Revit 패밀리 매칭 >> 인덱스 추출"; CPython3
# ---------- python_script_엑셀_revit_패밀리_매칭.python (24 lines) ----------
import clr
clr.AddReference("RevitAPI")
clr.AddReference("RevitAPIUI")

from Autodesk.Revit.DB import FilteredElementCollector, BuiltInCategory, Transaction, ElementId
from Autodesk.Revit.DB import Transaction

fname = IN[0]
exname = IN[1]

final_name = []
final_a = []
final = []

for i in range(len(exname)):
    final_name.append(list(set(exname[i]) & set(fname)))

for i in range(len(final_name)):
    final_a = []
    for j in range(len(final_name[i])):
        final_a.append(exname[i].index(final_name[i][j]))
    final.append(final_a)

OUT = final
# ----------------------------------------
getItemAtIndex_13 = List.GetItemAtIndex(list=watch, index=python_script_엑셀_revit_패밀리_매칭, lacing=Shortest)
getItemAtIndex_14 = List.GetItemAtIndex(list=python_script_공백과_제거_패밀리_별_수식, index=python_script_엑셀_revit_패밀리_매칭, lacing=Shortest)
getItemAtIndex_15 = List.GetItemAtIndex(list=list_getitematindex_패밀리명_추출, index=python_script_엑셀_revit_패밀리_매칭, lacing=Shortest)
getItemAtIndex_16 = List.GetItemAtIndex(list=getItemAtIndex_12, index=python_script_엑셀_revit_패밀리_매칭, lacing=Shortest)

# group: Excel 카테고리 별 데이터
수식 = Watch(getItemAtIndex_14)
패밀리_이름 = Watch(getItemAtIndex_15)
매칭코드 = Watch(getItemAtIndex_16)

# group: 토공 수식 제외 & 수식 별 변수 추출
boolean_6 = BoolSelector(true)
boolean_7 = BoolSelector(false)
python_script_문자열에서_특수문자_숫자_제거하기 = Python(IN[0]=수식)  # CPython3
# ---------- python_script_문자열에서_특수문자_숫자_제거하기.python (32 lines) ----------
import clr
clr.AddReference("RevitAPI")
clr.AddReference("RevitAPIUI")

from Autodesk.Revit.DB import FilteredElementCollector, BuiltInCategory, Transaction, ElementId
from Autodesk.Revit.DB import Transaction

formula = IN[0]
output = []
output1 = []
output2 = []

def replace_special_characters_in_parameter(parameter, replacement_word):
    # 특수문자를 replacement_word로 교체 후 반환
    special_characters = "!@#$%^&*()_+{}|:\"<>?`1234567890-=[]\\;',./!\"§$%&/()=?@€{}"
    for char in special_characters:
        parameter = parameter.replace(char, replacement_word)
    return parameter

def remove_word_from_list(input_list, word_to_remove):
    return [word for word in input_list if word != word_to_remove]

# 요소들의 특정 파라미터에서 특수문자 제거
for i in range(len(formula)):
    for j in range(len(formula[i])):
        for k in range(len(formula[i][j])):
            formula[i][j][k] = replace_special_characters_in_parameter(formula[i][j][k], '_')
            formula[i][j][k] = formula[i][j][k].split('_')
            formula[i][j][k] = remove_word_from_list(formula[i][j][k], '')
# 문자열을 쉼표(,)를 기준으로 분할

OUT = formula
# ----------------------------------------
count_2 = List.Count(list=python_script_문자열에서_특수문자_숫자_제거하기@L4)
flatten_2 = List.Flatten(list=python_script_문자열에서_특수문자_숫자_제거하기@L3)
uniqueItems = List.UniqueItems(list=flatten_2@L2)
python_script_토공량_관련_변수_인덱스_추출 = Python(IN[0]=uniqueItems, IN[1]=boolean_6, IN[2]=boolean_7)  # CPython3
# ---------- python_script_토공량_관련_변수_인덱스_추출.python (23 lines) ----------
import clr
clr.AddReference("RevitAPI")
clr.AddReference("RevitAPIUI")

from Autodesk.Revit.DB import FilteredElementCollector, BuiltInCategory, Transaction, ElementId
from Autodesk.Revit.DB import Transaction

para = IN[0]
true = IN[1]
false = IN[2]

for i in range(len(para)):
    for j in range(len(para[i])):
        if para[i][j] == 'Exca':
            para[i][j] = false
        elif para[i][j] == 'Back':
            para[i][j] = false
        elif para[i][j] == 'Disp':
            para[i][j] = false
        else:
            para[i][j] = true

OUT = para
# ----------------------------------------
allIndicesOf_4 = List.AllIndicesOf(list=python_script_토공량_관련_변수_인덱스_추출, item=boolean_6, lacing=CrossProduct)
getItemAtIndex_17 = List.GetItemAtIndex(list=uniqueItems, index=allIndicesOf_4, lacing=Shortest)

# group: 토공 수식 제외 & 산출식 정리
flatten_3 = List.Flatten(list=수식@L2)
python_script_토공량_관련_수식_제외한_인덱스 = Python(IN[0]=flatten_3, IN[1]=boolean_6, IN[2]=boolean_7)  # "Python Script : 토공량 관련 수식 제외한 인덱스 추출"; CPython3; same code as python_script_토공량_관련_변수_인덱스_추출
allIndicesOf_5 = List.AllIndicesOf(list=python_script_토공량_관련_수식_제외한_인덱스, item=boolean_6, lacing=CrossProduct)
allIndicesOf_6 = List.AllIndicesOf(list=python_script_토공량_관련_수식_제외한_인덱스, item=boolean_7, lacing=CrossProduct)
getItemAtIndex_18 = List.GetItemAtIndex(list=flatten_3, index=allIndicesOf_5, lacing=Shortest)

# group (continued): 객체 필터
allIndicesOf_7 = List.AllIndicesOf(list=name, item=패밀리_이름)
getItemAtIndex_19 = List.GetItemAtIndex(list=flatten, index=allIndicesOf_7)

# group: 패밀리 별 요소
flatten_4 = List.Flatten(list=getItemAtIndex_19@L2)

# group: Excel : Parameter 추출
string_7 = StringInput("물량Param")
importExcel_2 = Data.ImportExcel(file=file_from_path, sheetName=string_7)
number_3 = DoubleInput(3)
dropItems_2 = List.DropItems(list=importExcel_2, amount=number_3)
transpose_2 = List.Transpose(lists=dropItems_2)
restOfItems_2 = List.RestOfItems(list=transpose_2)
true_9_한글판_false_10_영문판 = BoolSelector(true)
formula_2 = Formula("if(boolean=True, 9, 10)", boolean=true_9_한글판_false_10_영문판)
getItemAtIndex_20 = List.GetItemAtIndex(list=restOfItems_2, index=formula_2)
number_4 = DoubleInput(1)
getItemAtIndex_21 = List.GetItemAtIndex(list=restOfItems_2, index=number_4)
isNull_4 = Object.IsNull(object=getItemAtIndex_21)
boolean_8 = BoolSelector(false)
allIndicesOf_8 = List.AllIndicesOf(list=isNull_4, item=boolean_8)
lastItem = List.LastItem(list=allIndicesOf_8)
count_3 = List.Count(list=getItemAtIndex_21)
code_block_4 = CodeBlock(a=lastItem, b=count_3) { a..b-1; }
count_4 = List.Count(list=allIndicesOf_8)
code_block_5 = CodeBlock(n=count_4) { n-1; }
removeItemAtIndex = List.RemoveItemAtIndex(list=allIndicesOf_8, indices=code_block_5)
restOfItems_3 = List.RestOfItems(list=allIndicesOf_8)
code_block_6 = CodeBlock(a=removeItemAtIndex, b=restOfItems_3) { a..b-1; }
addItemToEnd = List.AddItemToEnd(item=code_block_4, list=code_block_6)
getItemAtIndex_22 = List.GetItemAtIndex(list=getItemAtIndex_20, index=addItemToEnd)
boolean_9 = BoolSelector(false)
clean_3 = List.Clean(list=getItemAtIndex_22, preserveIndices=boolean_9)
getItemAtIndex_23 = List.GetItemAtIndex(list=getItemAtIndex_21, index=allIndicesOf_8)
number_5 = DoubleInput(5)
getItemAtIndex_24 = List.GetItemAtIndex(list=restOfItems_2, index=number_5)
getItemAtIndex_25 = List.GetItemAtIndex(list=getItemAtIndex_24, index=addItemToEnd)
number_6 = DoubleInput(7)
getItemAtIndex_26 = List.GetItemAtIndex(list=restOfItems_2, index=number_6)
getItemAtIndex_27 = List.GetItemAtIndex(list=getItemAtIndex_26, index=addItemToEnd)
string_8 = StringInput("O")
eq = getItemAtIndex_27 == string_8
filterByBoolMask = List.FilterByBoolMask(list=getItemAtIndex_25, mask=eq)
number_7 = DoubleInput(4)
getItemAtIndex_28 = List.GetItemAtIndex(list=restOfItems_2, index=number_7)
getItemAtIndex_29 = List.GetItemAtIndex(list=getItemAtIndex_28, index=addItemToEnd)
filterByBoolMask_2 = List.FilterByBoolMask(list=getItemAtIndex_29, mask=eq)
clean_4 = List.Clean(list=filterByBoolMask_2.out, preserveIndices=boolean_9)

# group: Parameter 별 데이터
내장_매개변수_이름 = Watch(clean_3)
매칭코드_2 = Watch(getItemAtIndex_23)
입력_매개변수_밸류 = Watch(filterByBoolMask.in)
내장_매개변수_이름_산출식 = Watch(clean_4)
입력_매개변수_이름_산출식 = Watch(filterByBoolMask_2.in)

# group: 매칭 코드 별 매개변수 정리
allIndicesOf_9 = List.AllIndicesOf(list=매칭코드_2, item=매칭코드)
flatten_5 = List.Flatten(list=allIndicesOf_9@L3)
getItemAtIndex_30 = List.GetItemAtIndex(list=내장_매개변수_이름, index=flatten_5)
내장_매개변수_이름_2 = Watch(getItemAtIndex_30)
getItemAtIndex_31 = List.GetItemAtIndex(list=입력_매개변수_밸류, index=flatten_5)
사용자_입력_매개변수_밸류 = Watch(getItemAtIndex_31)
getItemAtIndex_32 = List.GetItemAtIndex(list=내장_매개변수_이름_산출식, index=flatten_5)
내장_매개변수_산출식 = Watch(getItemAtIndex_32)
getItemAtIndex_33 = List.GetItemAtIndex(list=입력_매개변수_이름_산출식, index=flatten_5)
사용자_입력_매개변수 = Watch(getItemAtIndex_33)

# group: 요소 별 전체 매개변수 (Excel:param시트 기준) 추출
join_4 = List.Join()  # unwired: list0, list1
flatten_6 = List.Flatten(list=getItemAtIndex_19@L2)
flatten_7 = List.Flatten(list=내장_매개변수_이름_2@L2)
python_script = Python(IN[0]=flatten_6, IN[1]=flatten_7)  # CPython3
# ---------- python_script.python (80 lines) ----------
# Revit API를 사용하기 위해 Revit DLL을 가져옵니다.
import sys
import clr
import re

clr.AddReference("RevitAPI")
clr.AddReference('RevitAPIUI')
clr.AddReference("RevitServices")

import Autodesk
from Autodesk.Revit.DB import *
import RevitServices
from RevitServices.Persistence import DocumentManager
from Autodesk.Revit.DB import FilteredElementCollector, BuiltInCategory, Transaction, ElementId
from Autodesk.Revit.DB import Transaction

# 입력된 Revit 요소 (특정 인스턴스 또는 유형)
element = UnwrapElement(IN[0])
name = IN[1]

doc = DocumentManager.Instance.CurrentDBDocument

def GPV(eType, pName):
	paramValue = None
	for i in eType.Parameters:
		if i.Definition.Name == pName:
			paramValue = i.AsValueString()
			#paramValue = i.AsDouble()
			break
		else:
			continue
	return paramValue

# Elememt 유형을 가져오는 함수 정의
def getet(element):
    element_id = element.GetTypeId()
    if element_id != ElementId.InvalidElementId:
        return doc.GetElement(element_id)
    else:
        return None

# parameter value 추출
output = []
out = []
out2 = []

output11 = []
output22 = []

for i in range(len(element)):
    for j in range(len(element[i])):
        for k in range(len(name[i])):
            output1 = []
            output2 = []
            output1 = [GPV(element[i][j], name[i][k]), name[i][k]]
            output11.append(output1)
            output2 = [GPV(getet(element[i][j]), name[i][k]), name[i][k]]
            output22.append(output2)

for i in range(len(output11)):
    if output11[i][0] == None:
        output.append(output22[i][0])
    else:
        output.append(output11[i][0])
        
# 특수문자를 삭제해보자

def replace_special_characters_in_parameter(parameter, replacement_word):
    # 특수문자를 replacement_word로 교체 후 반환
    special_characters = 'm²³ '
    for char in special_characters:
        parameter = parameter.replace(char, replacement_word)
    return parameter

for i in range(len(output)):
    output[i] = str(output[i])
    output[i] = replace_special_characters_in_parameter(output[i], '')
    output[i] = float(output[i])
    
OUT = output
# ----------------------------------------
count_5 = List.Count(list=flatten_7@L2)
count_6 = List.Count(list=flatten_6@L2)
ofRepeatedItem = List.OfRepeatedItem(item=count_5, amount=count_6, lacing=Shortest)
flatten_8 = List.Flatten(list=ofRepeatedItem)
chop = List.Chop(list=python_script, lengths=flatten_8)
flatten_9 = List.Flatten(list=사용자_입력_매개변수_밸류@L2)
ofRepeatedItem_2 = List.OfRepeatedItem(item=flatten_9, amount=count_6, lacing=Shortest)
flatten_10 = List.Flatten(list=ofRepeatedItem_2@L2)
combine_2 = List.Combine(combineFunction=join_4, list0=chop, list1=flatten_10)
flatten_11 = List.Flatten(list=내장_매개변수_산출식@L2)
ofRepeatedItem_3 = List.OfRepeatedItem(item=flatten_11, amount=count_6, lacing=Shortest)
flatten_12 = List.Flatten(list=ofRepeatedItem_3@L2)
flatten_13 = List.Flatten(list=사용자_입력_매개변수@L2)
ofRepeatedItem_4 = List.OfRepeatedItem(item=flatten_13, amount=count_6, lacing=Shortest)
flatten_14 = List.Flatten(list=ofRepeatedItem_4@L2)
combine_3 = List.Combine(combineFunction=join_4, list0=flatten_12, list1=flatten_14)
number_8 = DoubleInput(1)
chop_2 = List.Chop(list=combine_2, lengths=count_6)
전체_매개변수_밸류 = Watch(chop_2)
chop_3 = List.Chop(list=combine_3, lengths=count_6)
전체_매개변수_이름_산출식 = Watch(chop_3)

# group: 수식 & 변수 & 밸류 매칭
count_7 = List.Count(list=flatten_4@L2)
ofRepeatedItem_5 = List.OfRepeatedItem(item=getItemAtIndex_18, amount=count_7, lacing=Shortest)
flatten_15 = List.Flatten(list=ofRepeatedItem_5@L2)
toLower = String.ToLower(string=flatten_15)
ofRepeatedItem_6 = List.OfRepeatedItem(item=getItemAtIndex_17, amount=count_7, lacing=Shortest)
flatten_16 = List.Flatten(list=ofRepeatedItem_6@L2)
toLower_2 = String.ToLower(string=flatten_16)
allIndicesOf_10 = List.AllIndicesOf(list=combine_3, item=flatten_16, lacing=Shortest)
flatten_17 = List.Flatten(list=allIndicesOf_10@L3)
getItemAtIndex_34 = List.GetItemAtIndex(list=combine_2, index=flatten_17, lacing=Shortest)

# group: 수량 산출
evaluateFormula = Math.EvaluateFormula(formulaString=toLower, parameters=toLower_2, arguments=getItemAtIndex_34, lacing=Shortest)
count_8 = List.Count(list=getItemAtIndex_19@L2)
chop_4 = List.Chop(list=evaluateFormula, lengths=count_8)
watch_2 = Watch(chop_4)

join_5 = List.Join()  # unwired: list0, list1

# group: 토공수량을 포함하는 패밀리 별 요소
allIndicesOf_11 = List.AllIndicesOf(list=python_script_토공량_관련_변수_인덱스_추출, item=boolean_7, lacing=CrossProduct)
isEmpty = List.IsEmpty(list=allIndicesOf_11@L2)
boolean_10 = BoolSelector(false)
allIndicesOf_12 = List.AllIndicesOf(list=isEmpty, item=boolean_10)
getItemAtIndex_35 = List.GetItemAtIndex(list=flatten_4, index=allIndicesOf_12)

boundingBox = Element.BoundingBox(element=getItemAtIndex_35)
toPolySurface = BoundingBox.ToPolySurface(boundingBox=boundingBox)
flatten_18 = List.Flatten(list=toPolySurface)
surfaces = PolySurface.Surfaces(polySurface=flatten_18)
number_9 = DoubleInput(0.5)
normalAtParameter = Surface.NormalAtParameter(surface=surfaces, u=number_9, v=number_9)
Z = Vector.Z(vector=normalAtParameter)
number_10 = DoubleInput(1)
eq_2 = Z == number_10
number_11 = DoubleInput(-1)
eq_3 = Z == number_11
eq_4 = eq_2 == eq_3  # lacing=Shortest
boolean_11 = BoolSelector(false)
allIndicesOf_13 = List.AllIndicesOf(list=eq_4, item=boolean_11, lacing=CrossProduct)
getItemAtIndex_36 = List.GetItemAtIndex(list=surfaces, index=allIndicesOf_13, lacing=Shortest)
lastItem_2 = List.LastItem(list=getItemAtIndex_36@L2)
perimeterCurves = Surface.PerimeterCurves(surface=lastItem_2)
byJoinedCurves = PolyCurve.ByJoinedCurves(curves=perimeterCurves)

# group: 토공량 관련 변수 및 밸류 목록
flatten_19 = List.Flatten(list=사용자_입력_매개변수_밸류@L2)
getItemAtIndex_37 = List.GetItemAtIndex(list=flatten_19, index=allIndicesOf_12)
flatten_20 = List.Flatten(list=사용자_입력_매개변수@L2)
getItemAtIndex_38 = List.GetItemAtIndex(list=flatten_20, index=allIndicesOf_12)

# group: 터파기 여유폭 추출
string_9 = StringInput("D2")
indexOf_6 = List.IndexOf(list=getItemAtIndex_38, element=string_9, lacing=CrossProduct)
python_script_없는_변수는_0값으로_생성 = Python(IN[0]=getItemAtIndex_37, IN[1]=indexOf_6)  # CPython3
# ---------- python_script_없는_변수는_0값으로_생성.python (20 lines) ----------
import clr
clr.AddReference("RevitAPI")
clr.AddReference("RevitAPIUI")

from Autodesk.Revit.DB import FilteredElementCollector, BuiltInCategory, Transaction, ElementId
from Autodesk.Revit.DB import Transaction

list = IN[0]
index = IN[1]
final = []

for i in range(len(index)):
    finalindex = []
    
    if index[i] == -1:
        final.append(0)
    else:
        final.append(list[i][(index[i])])
    
OUT = final
# ----------------------------------------

offset = Curve.Offset(curve=byJoinedCurves, distance=python_script_없는_변수는_0값으로_생성, lacing=Shortest)

# group: 터파기 깊이 계산
string_10 = StringInput("H2+C1+C2+C3")
toLower_3 = String.ToLower(string=string_10)
python_script_변수_추출 = Python(IN[0]=string_10)  # CPython3
# ---------- python_script_변수_추출.python (29 lines) ----------
import clr
clr.AddReference("RevitAPI")
clr.AddReference("RevitAPIUI")

from Autodesk.Revit.DB import FilteredElementCollector, BuiltInCategory, Transaction, ElementId
from Autodesk.Revit.DB import Transaction

formula = IN[0]
output = []
output1 = []
output2 = []

def replace_special_characters_in_parameter(parameter, replacement_word):
    # 특수문자를 replacement_word로 교체 후 반환
    special_characters = "!@#$%^&*()_+{}|:\"<>?`-=[]\\;',./!\"§$%&/()=?@€{}"
    for char in special_characters:
        parameter = parameter.replace(char, replacement_word)
    return parameter

def remove_word_from_list(input_list, word_to_remove):
    return [word for word in input_list if word != word_to_remove]

# 요소들의 특정 파라미터에서 특수문자 제거
formula = replace_special_characters_in_parameter(formula, '_')
formula = formula.split('_')
formula = remove_word_from_list(formula, '')
# 문자열을 쉼표(,)를 기준으로 분할

OUT = formula
# ----------------------------------------
toLower_4 = String.ToLower(string=python_script_변수_추출)
indexOf_7 = List.IndexOf(list=getItemAtIndex_38, element=python_script_변수_추출, lacing=CrossProduct)
python_script_없는_변수는_0값으로_생성_2 = Python(IN[0]=getItemAtIndex_37, IN[1]=indexOf_7)  # CPython3
# ---------- python_script_없는_변수는_0값으로_생성_2.python (23 lines) ----------
import clr
clr.AddReference("RevitAPI")
clr.AddReference("RevitAPIUI")

from Autodesk.Revit.DB import FilteredElementCollector, BuiltInCategory, Transaction, ElementId
from Autodesk.Revit.DB import Transaction

list = IN[0]
index = IN[1]
final = []

for i in range(len(index)):
    finalindex = []
    
    for j in range(len(index[i])):
        if index[i][j] == -1:
            finalindex.append(0)
        else:
            finalindex.append(list[i][(index[i][j])])
    
    final.append(finalindex)
    
OUT = final
# ----------------------------------------
evaluateFormula_2 = Math.EvaluateFormula(formulaString=toLower_3, parameters=toLower_4, arguments=python_script_없는_변수는_0값으로_생성_2)

translate = Geometry.Translate(geometry=offset, zTranslation=evaluateFormula_2)

# group: 터파기 구배로 상단 오프셋 계산
string_11 = StringInput("G")
indexOf_8 = List.IndexOf(list=getItemAtIndex_38, element=string_11, lacing=CrossProduct)
python_script_없는_변수는_0값으로_생성_3 = Python(IN[0]=getItemAtIndex_37, IN[1]=indexOf_8)  # CPython3; same code as python_script_없는_변수는_0값으로_생성
mul = python_script_없는_변수는_0값으로_생성_3 * evaluateFormula_2

offset_2 = Curve.Offset(curve=translate, distance=mul, lacing=Shortest)
combine_4 = List.Combine(combineFunction=join_5, list0=offset, list1=offset_2)
byLoft = Solid.ByLoft(crossSections=combine_4)
count_9 = List.Count(list=getItemAtIndex_35@L2)
chop_5 = List.Chop(list=byLoft, lengths=count_9)
byUnion = Solid.ByUnion(solids=chop_5)
volume = Solid.Volume(solid=byUnion)

# group: GL기준 기초 체적량
string_12 = StringInput("H2")
indexOf_9 = List.IndexOf(list=getItemAtIndex_38, element=string_12, lacing=CrossProduct)
python_script_없는_변수는_0값으로_생성_4 = Python(IN[0]=getItemAtIndex_37, IN[1]=indexOf_9)  # CPython3; same code as python_script_없는_변수는_0값으로_생성
flatten_21 = List.Flatten(list=getItemAtIndex_35)
string_13 = StringInput("면적")
parameterByName = Parameter.ParameterByName(element=flatten_21, name=string_13)
value = Parameter.Value(parameter=parameterByName)
mul_2 = python_script_없는_변수는_0값으로_생성_4 * value

sub = volume - mul_2

# group: VCF값 추출
string_14 = StringInput("VCF")
indexOf_10 = List.IndexOf(list=getItemAtIndex_38, element=string_14, lacing=CrossProduct)
python_script_없는_변수는_0값으로_생성_5 = Python(IN[0]=getItemAtIndex_37, IN[1]=indexOf_10)  # CPython3
# ---------- python_script_없는_변수는_0값으로_생성_5.python (20 lines) ----------
import clr
clr.AddReference("RevitAPI")
clr.AddReference("RevitAPIUI")

from Autodesk.Revit.DB import FilteredElementCollector, BuiltInCategory, Transaction, ElementId
from Autodesk.Revit.DB import Transaction

list = IN[0]
index = IN[1]
final = []

for i in range(len(index)):
    finalindex = []
    
    if index[i] == -1:
        final.append(1)
    else:
        final.append(list[i][(index[i])])
    
OUT = final
# ----------------------------------------

mul_3 = sub * python_script_없는_변수는_0값으로_생성_5

# group: 토공 수량 산출
join_6 = List.Join()  # unwired: list0, list1, list2
excavation = Watch(volume)
backFill = Watch(sub)
disposal = Watch(mul_3)
combine_5 = List.Combine(combineFunction=join_6, list0=excavation, list1=backFill, list2=disposal)

# group: 데이터 취합 & Excel 내보내기
number_12 = DoubleInput(1)
chop_6 = List.Chop(list=clean, lengths=number_12)
number_13 = DoubleInput(5)
string_15 = StringInput("Quantity")
contains_7 = String.Contains(string=string_from_object, searchFor=string_15, ignoreCase=boolean)
indexOf_11 = List.IndexOf(list=contains_7, element=boolean, lacing=CrossProduct)
add = indexOf_11 + number_12
getItemAtIndex_39 = List.GetItemAtIndex(list=transpose@L3, index=indexOf_11, lacing=Shortest)
python_script_데이터_초기화_공백으로_치환 = Python(IN[0]=getItemAtIndex_39)  # CPython3
# ---------- python_script_데이터_초기화_공백으로_치환.python (15 lines) ----------
import clr
clr.AddReference("RevitAPI")
clr.AddReference("RevitAPIUI")

from Autodesk.Revit.DB import FilteredElementCollector, BuiltInCategory, Transaction, ElementId
from Autodesk.Revit.DB import Transaction

data = IN[0]

# 요소들의 특정 파라미터에서 특수문자 제거
for i in range(len(data)):
    for j in range(len(data[i])):
        data[i][j] = ""
    
OUT = data
# ----------------------------------------
getItemAtIndex_40 = List.GetItemAtIndex(list=python_script_데이터_초기화_공백으로_치환, index=code_block_3, lacing=Shortest)
getItemAtIndex_41 = List.GetItemAtIndex(list=allIndicesOf_2, index=python_script_엑셀_revit_패밀리_매칭, lacing=Shortest)
chop_7 = List.Chop(list=allIndicesOf_5, lengths=count_2)
chop_8 = List.Chop(list=allIndicesOf_6, lengths=count_2)
transpose_3 = List.Transpose(lists=watch_2@L3)
sum = Math.Sum(values=transpose_3)
chop_9 = List.Chop(list=sum, lengths=count_2)
isEmpty_2 = List.IsEmpty(list=chop_8@L2)
boolean_12 = BoolSelector(true)
boolean_13 = BoolSelector(false)
python_script_토공수량_정리 = Python(IN[0]=combine_5, IN[1]=isEmpty_2, IN[2]=boolean_12, IN[3]=boolean_13)  # CPython3
# ---------- python_script_토공수량_정리.python (25 lines) ----------
import clr
clr.AddReference("RevitAPI")
clr.AddReference("RevitAPIUI")

from Autodesk.Revit.DB import FilteredElementCollector, BuiltInCategory, Transaction, ElementId
from Autodesk.Revit.DB import Transaction

civil_quan = IN[0]
bool_list = IN[1]
true = IN[2]
false = IN[3]
final = []

for i in range(len(bool_list)):
    if bool_list[i] == true:
        final.append("")
        civil_quan.insert(i, "")
        
    elif bool_list[i] == false:
        final.append(civil_quan[i])
        
    else:
        pass

OUT = final
# ----------------------------------------
chop_10 = List.Chop(list=python_script_토공수량_정리, lengths=count_2)
python_script_최종_수량 = Python(IN[0]=getItemAtIndex_40, IN[1]=getItemAtIndex_41, IN[2]=getItemAtIndex_13, IN[3]=chop_7, IN[4]=chop_8, IN[5]=chop_9, IN[6]=chop_10)  # CPython3
# ---------- python_script_최종_수량.python (27 lines) ----------
import clr
clr.AddReference("RevitAPI")
clr.AddReference("RevitAPIUI")

from Autodesk.Revit.DB import FilteredElementCollector, BuiltInCategory, Transaction, ElementId
from Autodesk.Revit.DB import Transaction

data = IN[0]
index1 = IN[1]
index2 = IN[2]
index2_1 = IN[3]
index2_2 = IN[4]
quan = IN[5]
civil_quan = IN[6]

for i in range(len(data)):
    for j in range(len(index1[i])):
        for k in range(len(index2[i][j])):
            if k in index2_1[i][j]:
                data[i][(index1[i][j])][(index2[i][j][k])] = quan[i][j][k]
            elif k in index2_2[i][j]:
                index = int(index2_2[i][j].index(k))
                data[i][(index1[i][j])][(index2[i][j][k])] = civil_quan[i][j][index]
            else:
                pass

OUT = data
# ----------------------------------------
flatten_22 = List.Flatten(list=python_script_최종_수량@L3)
chop_11 = List.Chop(list=flatten_22@L2, lengths=number_12)
exportToExcel = Data.ExportToExcel(filePath=file_path_excel_파일_선택, sheetName=chop_6, startRow=number_13, startColumn=add, data=chop_11)
