# Dynamo graph hCalc(pythonAIO)_rH(20231118).dyn (Dynamo 2.16.1.2727)
# author: MK Jang
# Auto Calculating the Quantities of each Element As per the Family List

lang_mode_영_한_select = BoolSelector(true)
토공_산출_모드_선택 = CustomSelection("개별 터파기", items={개별 터파기: "0", 온통 터파기: "1"})  # graph input

# group: All Data in Excel
family_list_경로_입력 = Filename(".\플랜트건축팀_BIM_팀 표준 Family List_Rev.0_시연용_20231107.xlsx")  # graph input
file_from_path = FileObject(path=family_list_경로_입력)
code_block = CodeBlock()
# ---------- code_block.designscript (16 lines) ----------
[
"WM-AR"
,"물량Param"
,"1.Floors"
,"2.Roofs"
,"3.Walls"
,"4.St Fdn"
,"5.St Col"
,"6.St Framing"
,"7.Ceilings"
,"8.Doors"
,"9.Windows"
,"10.Stairs"
,"11.Railings"
//,"13.Generic"
];
# ----------------------------------------
boolean = BoolSelector(true)
importExcel = Data.ImportExcel(file=file_from_path, sheetName=code_block, showExcel=boolean)

# group: All Elements in Revit
all_elementsexceptrails = Python()  # CPython3; unwired: IN[0]
# ---------- all_elementsexceptrails.python (51 lines) ----------
# Load the Python Standard and DesignScript Libraries
import sys
import clr
clr.AddReference('ProtoGeometry')
from Autodesk.DesignScript.Geometry import *

clr.AddReference('RevitAPI')
from Autodesk.Revit.DB import *
import Autodesk

clr.AddReference('RevitServices')
import RevitServices
from RevitServices.Persistence import DocumentManager
doc = DocumentManager.Instance.CurrentDBDocument

def get_all_BIC():

    db = [
    Autodesk.Revit.DB.BuiltInCategory.OST_Floors,
    Autodesk.Revit.DB.BuiltInCategory.OST_Roofs,
    Autodesk.Revit.DB.BuiltInCategory.OST_Walls,
    Autodesk.Revit.DB.BuiltInCategory.OST_StructuralFoundation,
    Autodesk.Revit.DB.BuiltInCategory.OST_StructuralColumns,
    Autodesk.Revit.DB.BuiltInCategory.OST_StructuralFraming,
    Autodesk.Revit.DB.BuiltInCategory.OST_Ceilings,
    Autodesk.Revit.DB.BuiltInCategory.OST_Doors,
    Autodesk.Revit.DB.BuiltInCategory.OST_Windows,
    Autodesk.Revit.DB.BuiltInCategory.OST_Stairs,
    #Autodesk.Revit.DB.BuiltInCategory.OST_Railings,
    ]
    return db
    
def get_allElems(doc):
    bics = get_all_BIC()
    
    def getElems(x):
        collector = FilteredElementCollector(doc)
        res = collector.OfCategory(x).WhereElementIsNotElementType().ToElements()
        return res

    def getRailElems(x):
        collector = FilteredElementCollector(doc)
        res = collector.OfCategory(x).WhereElementIsNotElementType()
        return res

    res = map(getElems, bics)
#    res = getRailElems(Autodesk.Revit.DB.BuiltInCategory.OST_RailingSystemRail)
    return res


OUT = get_allElems(doc)
# ----------------------------------------
categories = Categories("OST_StairsRailing")
all_elements_of_category = ElementsOfCategory(Category=categories)
list_create = List.Create(item0=all_elements_of_category)
join = List.Join(list0=all_elementsexceptrails, list1=list_create)

flatten = List.Flatten(list=join)

# group: 기준 그라운드레벨 선택
categories_2 = Categories("OST_Levels")
all_elements_of_category_2 = ElementsOfCategory(Category=categories_2)
name = Level.Name(level=all_elements_of_category_2)
code_block_2 = CodeBlock { "G.L"; }
contains = String.Contains(string=name, searchFor=code_block_2)
filterByBoolMask = List.FilterByBoolMask(list=all_elements_of_category_2, mask=contains)
firstItem = List.FirstItem(list=filterByBoolMask.in)
elevation = Level.Elevation(level=firstItem)

wholeExca_CalcType = CodeBlock { "SF-Q0"; }
hCalc_FullCode = Python(IN[0]=lang_mode_영_한_select, IN[1]=토공_산출_모드_선택, IN[2]=importExcel, IN[3]=code_block, IN[4]=flatten, IN[5]=elevation, IN[6]=wholeExca_CalcType)  # CPython3
# ---------- hCalc_FullCode.python (703 lines) ----------
# Load the Python Standard and DesignScript Libraries
import sys
import clr
clr.AddReference('ProtoGeometry')
from Autodesk.DesignScript.Geometry import *

clr.AddReference('RevitAPI')
from Autodesk.Revit.DB import *
import Autodesk

clr.AddReference('RevitServices')
import RevitServices
from RevitServices.Persistence import DocumentManager
doc = DocumentManager.Instance.CurrentDBDocument

from functools import reduce
from functools import partial

clr.AddReference('ProtoGeometry')
from Autodesk.DesignScript.Geometry import *

import Revit

from itertools import chain
from functools import reduce
from copy import deepcopy
import operator
from itertools import groupby
import copy

def make_UnifiedDict(dictsList):
    dicts_AllInOne = {}
    for d in dictsList:
        dict_k_v = d.items()
        for k,v in dict_k_v:
            dicts_AllInOne[k] = v
    return dicts_AllInOne

def find_IsInStr(target, str):
    if target == None or str == None:
        pass
    else:
        res = target in str
        return res

def find_range_by_columnItem(db, col_idx, sep_rule):
    tdb = list(map(lambda x: x[col_idx], db))
    last_idx_tdb = len(tdb)-1
    tdb_enum = enumerate(tdb)
    res = list(filter(lambda x: find_IsInStr(sep_rule, x[1]), tdb_enum))
    endidxs_tmp= list(map(lambda x: x[0]-1,res))
    endidxs_tmp.pop(0)
    endidxs = endidxs_tmp + [last_idx_tdb]
    famTypeNames = list(map(lambda x: x[1],res))
    famTypeNamesIdxs = list(map(lambda x: x[0],res))
    rangeSttIdxs = list(map(lambda x: x[0]+1,res))
    rangeEndIdxs = endidxs
    result = dict(zip(famTypeNames, zip(famTypeNamesIdxs, zip(rangeSttIdxs,rangeEndIdxs))))
    return result

def find_headersAtSheet(sheet):
    headers_sheet = map(lambda x: [x[1].replace("\n",""),x[0]], filter(lambda x: x[1] != None, enumerate(sheet[1])))
    
    return dict(headers_sheet)

def find_rangesAtSheet(sheet, hdrs_withIdx, trgt_hdr, trgt_str):
    return find_range_by_columnItem(sheet, hdrs_withIdx[trgt_hdr], trgt_str)

def get_DataOnRangesAtParamSheet(sheet):
    
    hdrs_withIdx = find_headersAtSheet(sheet)
    rangesATSheet = find_rangesAtSheet(sheet, hdrs_withIdx, "Q'ty Cal Type Tag", "-")
    title_idx = map(lambda x: x[0], rangesATSheet.values())
    calcType_colDatas = list(map(lambda x: x[hdrs_withIdx["Q'ty Cal Type Tag"]], sheet))
    calcTypes = list(map(lambda x: calcType_colDatas[x], title_idx))
    rgs_v = list(map(lambda x: x[1], rangesATSheet.values()))
    rgs_k = list(map(lambda x: x, rangesATSheet.keys()))
    
    hdrs_v = list(hdrs_withIdx.values())
    hdrs_k = list(hdrs_withIdx.keys())
    eff_hdrs_v = hdrs_v[2:]
    eff_hdrs_k = hdrs_k[2:]
    
    datas_allCalType = list(map(lambda x: sheet[x[0]-1:x[1]], rgs_v))
    
    def setDict_OnEachCalType(data_calType):
        paramName_lang = "패밀리 매개변수(from Revit) 영문판" if lang_mode is True else "패밀리 매개변수(from Revit) 한글판"
        calcTypeName = data_calType[0][2]
        data_calType_noneless = list(filter(lambda x: x[hdrs_withIdx["항목"]] != None, data_calType))
#        ## WM row 별 header명 과 짝짓기
        data_withHdrsIdx = list(map(lambda y: list(map(lambda x: y[x], eff_hdrs_v)), data_calType_noneless))
        dict_ = list(map(lambda x: dict(zip(eff_hdrs_k, x)), data_withHdrsIdx))
        dicts_noneless = list(map(lambda y: dict(filter(lambda x: x[1]!=None, y.items())),dict_))
#        ## dict_Cal Type 입력처리
        targetColName = "Q'ty Cal Type Tag"
        dicts_finalNoneless = []
        for d in dicts_noneless:
            d["Q'ty Cal Type Tag"] = calcTypeName
            
            if "입력값" in d.keys():
                d["applyForCalc"] = d["입력값"]
                dicts_finalNoneless.append(d)
            elif paramName_lang in d.keys():
                d["applyForCalc"] = d[paramName_lang]
                dicts_finalNoneless.append(d)
            else:
                pass
        
        return {calcTypeName: dicts_finalNoneless}
        
    return map(setDict_OnEachCalType, datas_allCalType)

def get_SymValDict_PerCalcType(dic):
    def findDictPerCalcType(dicList):
            dic = {}
            for i in dicList:
                dic[i["산출수식 약자"]] = i["applyForCalc"]
            return dic
    
    ks_forDic = list(dic.keys())
    vs_forDic = list(map(findDictPerCalcType, dic.values()))
    res = dict(zip(ks_forDic, vs_forDic))
    return res

def get_DataOnRangesAtCatSheet(catSheet):
    hdrs_withIdx = find_headersAtSheet(catSheet)
    rangesATSheet = find_rangesAtSheet(catSheet, hdrs_withIdx, "Family Type Name", "H_")
    title_idx = map(lambda x: x[0], rangesATSheet.values())
    calcType_colDatas = list(map(lambda x: x[hdrs_withIdx["Q'ty Cal Type Tag"]], catSheet))
    calcTypes = list(map(lambda x: calcType_colDatas[x], title_idx))
    rgs_v = list(map(lambda x: x[1], rangesATSheet.values()))
    rgs_k = list(map(lambda x: x, rangesATSheet.keys()))
    
    hdrs_v = list(hdrs_withIdx.values())
    hdrs_k = list(hdrs_withIdx.keys())
    
    datas_allFamType = list(map(lambda x: list(zip(catSheet[x[0]-1:x[1]], range(x[0]-1,x[1]))), rgs_v))
    
    def setDict_OnEachFamType(data_famType):  ## 최종적으로 산출식 없는 것 걸러내기 추가해야 함
        titleData = list(data_famType).pop(0)[0]
        
        famTypeName = titleData[hdrs_withIdx["Family Type Name"]]
        calcTypeName = titleData[hdrs_withIdx["Q'ty Cal Type Tag"]]
        data_famType_noneless = list(filter(lambda x: x[0][5] != None, data_famType))
        ## WM row 별 header명 과 짝짓기
        data_withHdrsIdx = list(map(lambda y: [list(map(lambda x: y[0][x], hdrs_v)), y[1]], data_famType_noneless))
        hdrs_k.append("rIDX")
        dict_ = list(map(lambda x: dict(zip(hdrs_k, x[0]+[x[1]])), data_withHdrsIdx))
        dicts_noneless = list(map(lambda y: dict(filter(lambda x: x[1]!=None, y.items())),dict_))
        ## dict_gauge, 물량산출식 없는 항목 처리
        dicts_final = []
        needDefault_ColName = "Gauge Code"
        noneRemove_ColName = "Dynamo 물량산출식"
        for d in dicts_noneless:
            d["Family Type Name"] = famTypeName
            
            if calcTypeName == None:
                pass            
            elif noneRemove_ColName in d.keys():
                d["Q'ty Cal Type Tag"] = calcTypeName
                d[needDefault_ColName] = ""
                dicts_final.append(d)

        return dicts_final
        
    dicts_allFamType = list(map(lambda x: setDict_OnEachFamType(list(x)), datas_allFamType))
    ds_famTypesAtCatSheet = dict(zip(rgs_k, dicts_allFamType))
    ds_famTypesAtCatSheet_effCalcType = dict(filter(lambda x: all(list(map(lambda i: "Q'ty Cal Type Tag" in i, x[1]))), list(ds_famTypesAtCatSheet.items())))
    ds_famTypesAtCatSheet_noneless = dict(filter(lambda x: len(list(x[1]))!=0, list(ds_famTypesAtCatSheet_effCalcType.items())))
    
    return  ds_famTypesAtCatSheet_noneless

def make_AIOdic(allCatSheets):

    dataOnRanges_allCat = list(map(get_DataOnRangesAtCatSheet, allCatSheets))
    dataOnRanges_allCat_WithCatNames = list(zip(allCatSheetsNames, dataOnRanges_allCat))
    
    AIOdic = {}
    for d in dataOnRanges_allCat_WithCatNames:
        catName = d[0]
        dict_k_v = d[1].items()
        for k,v in dict_k_v:
            for wm in v:
                wm["SheetName"] = catName
            AIOdic[k] = v
    return AIOdic

def matchWith_paramDic(catSheetDic, paramSheetDic):
    headers = list(catSheetDic.values())[0][0].keys()
    wmspec_headers = list(filter(lambda x: "Work C" in x or "Spec" in x, headers))
    res = {}
    for famType,diclist in catSheetDic.items():
        new_diclist = []
        for d in diclist:
            new_d = {}
            keys = d.keys()
            keys_new = set(keys) - set(wmspec_headers)
            calcType = d["Q'ty Cal Type Tag"]
            new_d["Sym_Val Dict"] = paramSheetDic[calcType]
            new_d["wmSpecs"] = list(map(lambda x: d[x],wmspec_headers))
            for spec in keys_new:
                new_d[spec] = d[spec]
            new_diclist.append(new_d)
        
        res[famType] = new_diclist
        
    return res

def filterEffRevitElems(allRevitElemsFlatten, elemDicts):
    allFamTypesInExcel = elemDicts.keys()
    res = list(filter(lambda x: x.GetParameterValueByName("Type").GetParameterValueByName("Type Name") in allFamTypesInExcel, allRevitElemsFlatten))
    return res

def matchWith_Elem_Dict(famlist_dic,revitElems):
    res = []
    for i in revitElems:
        tmp = {}
        famTypeName = i.GetParameterValueByName("Type").GetParameterValueByName("Type Name")
        tmp["Elem"] = i
        tmp["wms"] = famlist_dic[famTypeName]
        
        res.append(tmp)
    return res

def update_sym_valDict(elemDicts):
    
    def make_newElemDict(elemDict):
        new_elemDict = {}
        elemDict_keys = elemDict.keys()
        elemDict_vals = list(elemDict.values())
        elemDict_items = list(elemDict.items())
        
        def get_newWMsWithcalculatedSymValSet(elemDict):
            elem = elemDict["Elem"]
            wms = elemDict["wms"]
            new_wms = []
            
            for wm in wms:
                new_wm ={}
                sym_valDict = wm["Sym_Val Dict"]
                #wm_keys = wm.Keys
                wm_keys = wm.keys()
                #wm_vals = wm.Values
                wm_vals = wm.values()
                wm_items = list(zip(wm_keys,wm_vals))
                
                #sv_keys = sym_valDict.Keys
                sv_keys = sym_valDict.keys()
                #sv_vals = sym_valDict.Values
                sv_vals = sym_valDict.values()
                sv_items = list(zip(sv_keys, sv_vals))
                sv_Dict = {}
                for k,v in sv_items:
                    if isinstance(v, str): ### 수정 필요 (굳이 v의 타입검사하는 이유?)
                        if v == "Level":
                            sv_Dict[k] = round(elem.GetParameterValueByName("Elevation at Bottom"),2)
                        elif elem.GetParameterValueByName(v):
                            sv_Dict[k] = elem.GetParameterValueByName(v)
                        elif elem.GetParameterValueByName("Type").GetParameterValueByName(v):
                            sv_Dict[k] = elem.GetParameterValueByName("Type").GetParameterValueByName(v)
                        else:
                            sv_Dict[k] = v
                    else:
                        sv_Dict[k] = v
                for k,v in wm_items:
                    if k == "Sym_Val Dict":
                        new_wm[k] = sv_Dict
                    else:
                        new_wm[k] = v
                new_wms.append(new_wm)
            return new_wms
                
                
        for k,v in elemDict_items:
            if k == "wms":
                new_elemDict[k] = get_newWMsWithcalculatedSymValSet(elemDict)
            else:
                new_elemDict[k] = v
                        
        return new_elemDict
    res = list(map(make_newElemDict, elemDicts))
    
    return res

def get_allElems(doc):
    target_bic = Autodesk.Revit.DB.BuiltInCategory.OST_Levels
    
    def getElems(x):
        collector = FilteredElementCollector(doc)
        res = collector.OfCategory(x).WhereElementIsNotElementType().ToElements()
        return res

    res = getElems(target_bic)

    return res

def getGroundLevelElem(allLevelElems):
    res = list(filter(lambda x: "G.L" in x.Name, allLevelElems))[0]
    return res

def makeExcaShape(elem, sym_valDict, FL_GL_gap):
    def findBtmCrv(geo, sym_valDict): ##btmOffset = d1 + d2
        offSetDist = sym_valDict["D1"] + sym_valDict["D2"]
        h = abs(sym_valDict["C1"] + sym_valDict["C2"] + sym_valDict["C3"])
        bdBox_fdn = BoundingBox.ByGeometry(geo).ToCuboid() ## 형상의 자그마한 요철 무시
        srfs = bdBox_fdn.Explode() ## surface들
        btmSrf = PolySurface.ByJoinedSurfaces(list(filter(lambda x: round(x.NormalAtParameter(0.5,0.5).Z, 3) == -1, srfs)))
        btmCrvs = btmSrf.PerimeterCurves()
        btmPolCrv = PolyCurve.ByJoinedCurves(btmCrvs)
        offseted_btmPolCrv = btmPolCrv.Offset(offSetDist)
        #h_modified_btmPolCrv = offseted_btmPolCrv.Translate(0,0,-h-Survey_Base_zGap)
        h_modified_btmPolCrv = offseted_btmPolCrv.Translate(0,0,-h)
        return h_modified_btmPolCrv
    
    def findUprCrv(_btmPolCrv, sym_valDict):
        btmCrvZ = _btmPolCrv.StartPoint.Z
        #test = (sym_valDict["C1"] + sym_valDict["C2"] + sym_valDict["C3"])

        H = abs(round(btmCrvZ,2))
        G = sym_valDict["G"]
        offSetDist = (G * H)
        
        #uprPolCrv = _btmPolCrv.Translate(0,0,H).Offset(offSetDist)
        uprPolCrv = _btmPolCrv.Translate(0,0,H + Survey_Base_zGap -FL_GL_gap).Offset(offSetDist)
        #uprCrvZ = uprPolCrv.StartPoint.Z
        return uprPolCrv


    fdnsGeo = elem.Geometry()[0]
    btmPolCrv = findBtmCrv(fdnsGeo, sym_valDict)
    uprPolCrv = findUprCrv(btmPolCrv, sym_valDict)
    res = Solid.ByLoft([btmPolCrv,uprPolCrv])#.Translate(0,0, Survey_Base_zGap - FL_GL_gap)
    return res

def makeExcaShape_whole(elemDicts, paramSheetDic, wholeExca_CalcType, FL_GL_gap):
    sym_valDict = paramSheetDic[wholeExca_CalcType]
    def findBtmCrv(geo, sym_valDict): ##btmOffset = d1 + d2
        offSetDist = sym_valDict["D1"] + sym_valDict["D2"]
        
        h = abs(sym_valDict["C1"] + sym_valDict["C2"] + sym_valDict["C3"])
        bdBox_fdn = BoundingBox.ByGeometry(geo).ToCuboid() ## 형상의 자그마한 요철 무시
        srfs = bdBox_fdn.Explode() ## surface들
        btmSrf = PolySurface.ByJoinedSurfaces(list(filter(lambda x: round(x.NormalAtParameter(0.5,0.5).Z, 3) == -1, srfs)))
        btmCrvs = btmSrf.PerimeterCurves()
        btmPolCrv = PolyCurve.ByJoinedCurves(btmCrvs)
        offseted_btmPolCrv = btmPolCrv.Offset(offSetDist)
        h_modified_btmPolCrv = offseted_btmPolCrv.Translate(0,0,-h)
        return h_modified_btmPolCrv
    
    def findUprCrv(_btmPolCrv, sym_valDict):
        btmCrvZ = _btmPolCrv.StartPoint.Z
        test = (sym_valDict["C1"] + sym_valDict["C2"] + sym_valDict["C3"])
        
        H = abs(round(btmCrvZ,2))
        G = sym_valDict["G"]
        offSetDist = (G * H)
        
        uprPolCrv = _btmPolCrv.Translate(0,0,H + Survey_Base_zGap -FL_GL_gap).Offset(offSetDist)
        uprCrvZ = uprPolCrv.StartPoint.Z
        return uprPolCrv
        
    def findExcaShapeByColFnds():
        all_ColFdnElems = list(map(lambda x: x["Elem"].Geometry()[0], filter(lambda dic: "ACF_W" in dic["wms"][0]["Family Type Name"], elemDicts)))
        resBdBox = BoundingBox.ByGeometry(all_ColFdnElems).ToCuboid()
        
        btmPolCrv = findBtmCrv(resBdBox, sym_valDict)
        uprPolCrv = findUprCrv(btmPolCrv, sym_valDict)
        res = Solid.ByLoft([btmPolCrv,uprPolCrv])#.Translate(0,0,FL_GL_gap)
        
        return res

    def findExcaShapeByMass():
        all_MassElems = list(map(lambda x: x["Elem"].Geometry()[0], filter(lambda dic: "ACE_Mass" in dic["wms"][0]["Family Type Name"], elemDicts)))
        if all_MassElems:
            resBdBox = BoundingBox.ByGeometry(all_MassElems).ToCuboid()
            btmPolCrv = findBtmCrv(resBdBox, sym_valDict)
            uprPolCrv = findUprCrv(btmPolCrv, sym_valDict)
            res = Solid.ByLoft([btmPolCrv,uprPolCrv])#.Translate(0,0,FL_GL_gap)
        else:
            res = []
        
        return res

    def findExcaShapeByPit():
        all_PitElems = list(map(lambda x: x["Elem"].Geometry()[0], filter(lambda dic: "ACP_Pit Slab" in dic["wms"][0]["Family Type Name"], elemDicts)))
        if all_PitElems:
            resBdBox = BoundingBox.ByGeometry(all_PitElems).ToCuboid()
            
            btmPolCrv = findBtmCrv(resBdBox, sym_valDict)
            uprPolCrv = findUprCrv(btmPolCrv, sym_valDict)
            res = Solid.ByLoft([btmPolCrv,uprPolCrv])#.Translate(0,0,FL_GL_gap)
        else:
            res = []
        return res
        
    finalTarget = list(filter(lambda x: x!=[] ,[findExcaShapeByColFnds(),findExcaShapeByMass(),findExcaShapeByPit()]))
    res = Solid.ByUnion(finalTarget)
    
    return res

def makeDispShape_whole(elemDicts, paramSheetDic, FL_GL_gap):
    total_ExcaGeo = makeExcaShape_whole(elemDicts, paramSheetDic, wholeExca_CalcType, FL_GL_gap)
    allGeo_UG_union = Solid.ByUnion(find_allGeo_UG_elems(elemDicts))
    dispShape = allGeo_UG_union.Split(total_ExcaGeo)[-1]
    backFillShape = total_ExcaGeo.Split(allGeo_UG_union)[0]
    return [dispShape, backFillShape]

def addExcaInElemDicts(elemDicts, FL_GL_gap):
    allExcas = []
    for idx,dic in enumerate(elemDicts):
        elem = dic["Elem"]
        wms = dic["wms"]
        excaBln = "Exca" in "".join(list(map(lambda x: x["Dynamo 물량산출식"], wms)))
        if excaBln:
            sym_valDict = wms[0]["Sym_Val Dict"]
            excaGeo = makeExcaShape(elem, sym_valDict, FL_GL_gap)
            try:
                allExcasUni = Solid.ByUnion(allExcas)
                eff_excaGeo = excaGeo.Split(allExcasUni)[0]
                allExcas.append(excaGeo)
            except:
                eff_excaGeo = excaGeo
                allExcas.append(excaGeo)
            dic["ExcaGeo"] = eff_excaGeo

    return elemDicts

def find_allGeo_UG_elems(elemDicts):
    geoResult = []
    for dic in elemDicts:
        elem = dic["Elem"]
        wms = dic["wms"]
        excaBln = "Exca" in "".join(list(map(lambda x: x["Dynamo 물량산출식"], wms)))
        famType_ = wms[0]["Family Type Name"]
            
        if "MAT_" in famType_ or "Mass_" in famType_ or "Pit" in famType_ or "Trench" in famType_:
            if "Slab" in famType_ or "MAT_" in famType_ or "Mass_" in famType_ : ## 내부 빈공간 있는 RC부재는 꽉채워서 공제 
                srfs = elem.Geometry()[0].Explode() ## surface들
                btmSrf = PolySurface.ByJoinedSurfaces(list(filter(lambda x: round(x.NormalAtParameter(0.5,0.5).Z, 3) == -1, srfs)))
                btmCrvs = btmSrf.PerimeterCurves()
                btmPolCrv = PolyCurve.ByJoinedCurves(btmCrvs)
                btmCrvZ = btmPolCrv.StartPoint.Z
                uprPolCrv = btmPolCrv.Translate(0,0,(0-btmCrvZ))
                targetGeo = Solid.ByLoft([btmPolCrv,uprPolCrv])
                geoResult.append(targetGeo)
            else:
                geoResult.append(elem.Geometry()[0])
        elif "PED_" in famType_ or "TG_" in famType_ or "SOG_" in famType_ or "UG" in famType_:
            geoResult.append(elem.Geometry()[0])
            
        elif excaBln:
            geoResult.append(elem.Geometry()[0])

    return geoResult

def add_effExcaInElemDicts(elemDicts):
    
    FL_GL_gap = 0-GL_zElev
    allGeo_UG_RC_Elems = find_allGeo_UG_elems(elemDicts)
    allUniGeo_UG_RC_Elems = Solid.ByUnion(allGeo_UG_RC_Elems)
    elemDicts_excas = addExcaInElemDicts(elemDicts, FL_GL_gap)
    
    for dic in elemDicts_excas:
        if "ExcaGeo" in dic.keys():
            excaGeo = dic["ExcaGeo"]

            eff_excaGeo = excaGeo
            splitResult = eff_excaGeo.Split(allUniGeo_UG_RC_Elems)
            dic["effExcaGeo"] = eff_excaGeo
            dic["effBackfillGeo"] = splitResult[0]

        
        wms = dic["wms"]
        for wm in wms:
            if "Exca" in wm["Dynamo 물량산출식"] or\
               "Back" in wm["Dynamo 물량산출식"] or\
               "Disp" in wm["Dynamo 물량산출식"]:
                wm["Sym_Val Dict"]["Exca"] = dic["effExcaGeo"].Volume
                wm["Sym_Val Dict"]["Back"] = dic["effBackfillGeo"].Volume
                wm["Sym_Val Dict"]["Disp"] = dic["effExcaGeo"].Volume - dic["effBackfillGeo"].Volume

    return elemDicts_excas

def findBtmSrfs(geo):
    srfs = geo.Explode()
    btmSrf = PolySurface.ByJoinedSurfaces(list(filter(lambda x: round(x.NormalAtParameter(0.5,0.5).Z, 3) == -1, srfs)))
    return btmSrf

def calc_EarthWorkValue_InElemDicts(elemDicts, GL_zElev, paramSheetDic, wholeExca_CalcType):
    FL_GL_gap = 0 - GL_zElev
    allEarthRelatedElemsBtmSrfs = list(
        map(lambda x: findBtmSrfs(x["Elem"].Geometry()[0]), 
            filter(lambda dic: "ACF_W" in dic["wms"][0]["Family Type Name"] or \
                               "ACB_TG" in dic["wms"][0]["Family Type Name"] or \
                               "ACS_SOG" in dic["wms"][0]["Family Type Name"] or \
                               "ACE_Mass" in dic["wms"][0]["Family Type Name"] or \
                               "ACP_Pit Slab" in dic["wms"][0]["Family Type Name"], \
                elemDicts)))
    total_btmSrfsArea = sum(map(lambda x: x.Area, allEarthRelatedElemsBtmSrfs))
    total_Exca = makeExcaShape_whole(elemDicts, paramSheetDic, wholeExca_CalcType, FL_GL_gap)
    total_ExcaVolume = total_Exca.Volume
    total_Disp = makeDispShape_whole(elemDicts, paramSheetDic, FL_GL_gap)[0]
    total_DispVolume = total_Disp.Volume
    total_BackFill = makeDispShape_whole(elemDicts, paramSheetDic, FL_GL_gap)[1]
    total_BackFillVolume = total_BackFill.Volume
    
    for dic in elemDicts:
        elem = dic["Elem"]
        wms = dic["wms"]
        famType = wms[0]["Family Type Name"]
        for wm in wms:
            if "Exca" in wm["Dynamo 물량산출식"] or\
               "Back" in wm["Dynamo 물량산출식"] or\
               "Disp" in wm["Dynamo 물량산출식"] : ### 토공 산출 대상 부재에는 Exca Back Disp 세트로 포함하도록
                elem_btmSrfArea = findBtmSrfs(elem.Geometry()[0]).Area
                wm["Sym_Val Dict"]["Exca"] = total_ExcaVolume * (elem_btmSrfArea / total_btmSrfsArea)
                wm["Sym_Val Dict"]["Back"] = total_BackFillVolume * (elem_btmSrfArea / total_btmSrfsArea)
                wm["Sym_Val Dict"]["Disp"] = total_DispVolume * (elem_btmSrfArea / total_btmSrfsArea)
    
    return [elemDicts, [total_Exca, total_BackFill]]

def finalCalc_SymValDict(elemDicts):
    for dic in elemDicts:
        wms = dic["wms"]
        for wm in wms:
            formula = wm["Dynamo 물량산출식"]
            SymValDicts = wm["Sym_Val Dict"]
            #SymValItems = list(zip(SymValDicts.Keys, SymValDicts.Values))
            SymValItems = SymValDicts.items()
            sym_val_keySets = []
            sym_val_valSets = []
            for k,v in SymValItems:
                if k in formula:
                    sym_val_keySets.append(k)
                    sym_val_valSets.append(v)
            #wm["Sym_Val Set"] = [sym_val_keySets,sym_val_valSets]
            wm["Sym_Val Set"] = dict(zip(sym_val_keySets,sym_val_valSets))
            formula_eqSymRemove = formula.lstrip("=")
            tmp = formula_eqSymRemove
            for k in sym_val_keySets: ## 이 부분은 좀더 범용 처리 필요할수도
                priorSymList = ["Exca", "Back", "Disp"]
                #any(list(map(lambda x: x in tmp, priorList)))
                #if "Exca" in tmp or "Back" in tmp or "Disp" in tmp:
                if any(list(map(lambda x: x in tmp, priorSymList))):
                    appliedSym = list(filter(lambda x: x in tmp, priorSymList))[0]
                    #if len(k) > 1:
                    if k == appliedSym:
                        tmp = tmp.replace(k, str(wm["Sym_Val Set"][k]))
                else:
                    tmp = tmp.replace(k, str(wm["Sym_Val Set"][k]))
                
            
            #wm["calcResult"] = tmp.strip()
            wm["calcResult"] = round(eval(tmp.strip()),3)
    
    return elemDicts

def extractCalcResult(elemDicts):
    res = []
    for d in elemDicts:
        wms = d["wms"]
        for wm in wms:
            keys = ["SheetName", "rIDX", "Work Master Code", "Family Type Name", "calcResult"]
            vals = list(map(lambda x: wm[x],keys))
            k_v = list(zip(keys, vals))
            res.append(dict(k_v))
        
    return res

def extractCalcResult_forTotalBOQ(elemDicts):
    res = []
    for d in elemDicts:
        wms = d["wms"]
        for wm in wms:
            keys = ["SheetName", "rIDX", "Work Master Code", "Gauge Code", "wmSpecs", "Family Type Name", "calcResult"]
            vals = list(map(lambda x: wm[x],keys))
            k_v = list(zip(keys, vals))
            res_d = dict(k_v)
            if "Description" in wm.Keys:
                res_d["Description"] = wm["Description"]
            else:
                res_d["Description"] = ""
            res_d["wmcANDgauge"] = "".join([wm["Work Master Code"],wm["Gauge Code"]])
            res_d["UoM"] = wm["Unit"]
            res.append(res_d)
        
    return res

def make_dict_groupBy_Sheet_WM(elemDicts):
    extractedDicts = extractCalcResult(elemDicts)
    sortedDicts_sheet = sorted(extractedDicts, key=operator.itemgetter("SheetName"))
    grpDicts_Sheet = groupby(sortedDicts_sheet, lambda x: x["SheetName"])
    
    res = {}
    for k, g in grpDicts_Sheet:
        sorted_g = sorted(list(g), key=operator.itemgetter("rIDX"))
        grped_g = groupby(sorted_g, lambda x: x["rIDX"])
        tmp = []
        for k_,g_ in grped_g:
            gg = copy.deepcopy(list(g_))
            calcSum = round(sum(map(lambda x: x["calcResult"],gg)),3)
            rIDX = gg[0]["rIDX"]
            tmp.append((rIDX,calcSum))
            
        res[k] = tmp
    return res

def fill_dict_emptySlot(dic):
    tmp = []
    for k, v in dic.items():
        all_idxs = list(map(lambda x: x[0],v))
        max_idx = max(all_idxs)
        full_range = range(0, max_idx+1)
        
        for i in full_range:
            if i not in all_idxs:
                v.append([i, ""])
        tmp.append(sorted(v, key=operator.itemgetter(0)))
        
    res = list(zip(dic.keys(),tmp))
    return dict(res)

def make_dict_groupBy_WM(elemDicts):
    extractedDicts = extractCalcResult_forTotalBOQ(elemDicts)
    sortedDicts_WMC = sorted(extractedDicts, key=operator.itemgetter("wmcANDgauge"))
    grpDicts_WMC = groupby(sortedDicts_WMC, key=operator.itemgetter("wmcANDgauge"))
    
    res = []
    for k, g in grpDicts_WMC: 
        wmCode = k
        gg = copy.deepcopy(list(g))
        calcSum = round(sum(map(lambda x: x["calcResult"], gg)),3)
        wmSpecs = gg[0]["wmSpecs"]
        catStr = "_".join([wmSpecs[0],wmSpecs[1]])
        specOnly = list(filter(lambda x: x!=0, wmSpecs))[3:]
        addSpec = gg[0]["Description"]
        dict_res = {
            "catStr": catStr,
            "Work Master Code": wmCode,
            "Gauge Code": gg[0]["Gauge Code"],
            "Description": wmSpecs[2],
            "Spec.": "\n".join(specOnly),
            "Additional Spec.": addSpec,
            "calcVal": calcSum,
            "UoM": gg[0]["UoM"]
            #"wmSpecs": wmSpecs,
            }
        res.append(dict_res)
    
    
    return res





# The inputs to this node will be stored as a list in the IN variables.
dataEnteringNode = IN
lang_mode = IN[0]
earthWork_calcMode = IN[1]
wholeDatas = IN[2]

allCatSheetsNames = IN[3][2:]

allRevitElemsFlatten = IN[4]
GL_zElev = IN[5]
wholeExca_CalcType = IN[6]

# Place your code below this line
db = wholeDatas[1:]
paramSheet = db[0]
allCatSheets = db[1:]
Survey_Base_zGap = Revit.Elements.Coordinates.BasePoint().Z - Revit.Elements.Coordinates.SurveyPoint().Z

calcTypeDictsList = get_DataOnRangesAtParamSheet(paramSheet)
calcTypeDict = make_UnifiedDict(calcTypeDictsList)
paramSheetDic = get_SymValDict_PerCalcType(calcTypeDict) 

catSheetDic = make_AIOdic(allCatSheets)
catFam_paramDic = matchWith_paramDic(catSheetDic, paramSheetDic)

filteredEffRevitElems = filterEffRevitElems(allRevitElemsFlatten, catSheetDic)

elemDicts_updated_sym_valDict = update_sym_valDict(matchWith_Elem_Dict(catFam_paramDic,filteredEffRevitElems))


def getCompleteDicts_earth(elemDicts):
    if earthWork_calcMode:
        return calc_EarthWorkValue_InElemDicts(elemDicts, GL_zElev, paramSheetDic, wholeExca_CalcType)
    else:
        return [add_effExcaInElemDicts(elemDicts),0]


elemDicts_updated_Earthwork = getCompleteDicts_earth(elemDicts_updated_sym_valDict)
elemDicts_finalCalculated = finalCalc_SymValDict(elemDicts_updated_Earthwork[0])
dict_groupBy_Sheet_WM = make_dict_groupBy_Sheet_WM(elemDicts_finalCalculated)
resultForFamList = fill_dict_emptySlot(dict_groupBy_Sheet_WM)
resultForTotalBOQ = dict_groupBy_Sheet_WM



# Assign your output to the OUT variable.
OUT = [resultForFamList, resultForTotalBOQ]
# ----------------------------------------
code_block_3 = CodeBlock(hCalc_FullCode_result=hCalc_FullCode) { hCalc_FullCode_result; }
code_block_4 = CodeBlock(i=code_block_3) { i[0]; }  # frozen

# group: Family List엑셀파일 물량 기입 구간
code_block_5 = CodeBlock { file_path; }  # unwired: file_path
components = DesignScript.Builtin.Dictionary.Components(dictionary=code_block_4)
code_block_6 = CodeBlock { 6; 31; }
code_block_7 = CodeBlock { 1; }
getItemAtIndex = List.GetItemAtIndex(list=components.values@@L2, index=code_block_7)
dropItems = List.DropItems(list=getItemAtIndex@L2, amount=code_block_6.out0)
exportToExcel = Data.ExportToExcel(filePath=code_block_5, sheetName=components.keys@L1, startRow=code_block_6.out0, startColumn=code_block_6.out1, data=dropItems@L2)

total_boq_sheet_경로_입력 = Filename(".\Total BOQ_blank.xlsx")  # graph input
code_block_8 = CodeBlock(TotalBOQ_path=total_boq_sheet_경로_입력) { TotalBOQ_path; }  # frozen
건물명_입력 = StringInput("Please enter Building Name before running ")  # graph input
code_block_9 = CodeBlock(buildingName=건물명_입력) { buildingName; }
code_block_10 = CodeBlock(buildingName=code_block_9) { buildingName; }
firstItem_2 = List.FirstItem(list=importExcel)
code_block_11 = CodeBlock(wm_sheetDatas=firstItem_2) { wm_sheetDatas; }

# group: [WM-AR] 시트 데이터 정리
code_block_12 = CodeBlock(wm_sheetDatas=code_block_11) { wm_sheetDatas; }
code_block_13 = CodeBlock { 3; }
getItemAtIndex_2 = List.GetItemAtIndex(list=code_block_12@L2, index=code_block_13)
code_block_14 = CodeBlock { 6; }
dropItems_2 = List.DropItems(list=getItemAtIndex_2, amount=code_block_14)
uniqueItems = List.UniqueItems(list=dropItems_2)
code_block_15 = CodeBlock(description판별항목1=uniqueItems) { description판별항목1; }
code_block_16 = CodeBlock { 5; }
getItemAtIndex_3 = List.GetItemAtIndex(list=code_block_12@L2, index=code_block_16)
code_block_17 = CodeBlock { 6; }
dropItems_3 = List.DropItems(list=getItemAtIndex_3, amount=code_block_17)
uniqueItems_2 = List.UniqueItems(list=dropItems_3)
code_block_18 = CodeBlock(description판별항목2=uniqueItems_2) { description판별항목2; }

description판별항목 = CodeBlock(description판별항목1=code_block_15, description판별항목2=code_block_18) { description판별항목1; description판별항목2; }
code_block_19 = CodeBlock(i=code_block_3) { i[1]; }

# group: Total BOQ 엑셀파일 물량 기입 구간
code_block_20 = CodeBlock { "(AR) BOQ"; false; }
code_block_21 = CodeBlock(TotalBOQ_path=code_block_8, sheetName=code_block_20.out0) { TotalBOQ_path; sheetName; }
list_create_2 = List.Create(item0=description판별항목.description판별항목1, item1=description판별항목.description판별항목2)
# note: Work Master Code
# Gauge Code
# Description : (L03)
# Spec. : (L04~L11)
# Additional Spec : (Description 항목 값)
file_from_path_2 = FileObject(path=code_block_8)  # frozen
importExcel_2 = Data.ImportExcel(file=file_from_path_2, sheetName=code_block_20.out0, showExcel=code_block_20.out1)
total_boq_데이터_파싱__ar_boq시트 = Python(IN[0]=code_block_10, IN[1]=list_create_2, IN[2]=importExcel_2)  # CPython3
# ---------- total_boq_데이터_파싱__ar_boq시트.python (162 lines) ----------
# Load the Python Standard and DesignScript Libraries
import sys
import clr
clr.AddReference('ProtoGeometry')
from Autodesk.DesignScript.Geometry import *

from functools import reduce
from functools import partial
from string import ascii_lowercase
import itertools
from itertools import chain
import re
    
#################################Module For Functional Programing#############################################
curry = lambda f: lambda a,*args: f(a, *args) if (len(args)) else lambda *args: f(a, *args)

filter = curry(filter)
map = curry(map)

def _take(length, iter):
    res = []
    for a in iter:
        res.append(a)
        if len(res) == length:
            return res
        
take = curry(_take)
reduce = curry(reduce)

go = lambda *args: reduce(lambda a,f: f(a), args) ## 함수도 축약 가능 ##
##############################################################################################################
def find_IsInStr(target, str):
    if target == None or str == None:
        pass
    else:
        res = target in str
        return res
        
def find_IsInList(List, str):
    if str == None or List == None:
        pass
    else:
        res = str in List
        return res

def find_range_by_columnItem(db, col_idx, sep_rule):
    tdb = list(map(lambda x: x[col_idx], db))
    last_idx_tdb = len(tdb)-1
    tdb_enum = enumerate(tdb)
    res = list(filter(lambda x: find_IsInStr(sep_rule, x[1]), tdb_enum))
    endidxs_tmp= list(map(lambda x: x[0]-1,res))
    #endidxs_tmp= list(map(lambda x: x[0],res))
    endidxs_tmp.pop(0)
    endidxs = endidxs_tmp + [last_idx_tdb]
    famTypeNames = list(map(lambda x: x[1],res))
    famTypeNamesIdxs = list(map(lambda x: x[0],res))
    rangeSttIdxs = list(map(lambda x: x[0]+1,res))
    rangeEndIdxs = endidxs
    result = dict(zip(famTypeNames, zip(famTypeNamesIdxs, zip(rangeSttIdxs,rangeEndIdxs))))
    return result
    
def find_range_by_columnItem_discrim(db, col_idx, 판별항목):
    tdb = list(map(lambda x: x[col_idx], db))
    last_idx_tdb = len(tdb)-1
    tdb_enum = enumerate(tdb)
    res = list(filter(lambda x: find_IsInList(판별항목, x[1]), tdb_enum))
    endidxs_tmp= list(map(lambda x: x[0]-1,res))
    #endidxs_tmp= list(map(lambda x: x[0],res))
    endidxs_tmp.pop(0)
    endidxs = endidxs_tmp + [last_idx_tdb]
    famTypeNames = list(map(lambda x: x[1],res))
    famTypeNamesIdxs = list(map(lambda x: x[0],res))
    rangeSttIdxs = list(map(lambda x: x[0]+1,res))
    rangeEndIdxs = endidxs
    result = dict(zip(famTypeNames, zip(famTypeNamesIdxs, zip(rangeSttIdxs,rangeEndIdxs))))
    return result

# The inputs to this node will be stored as a list in the IN variables.
dataEnteringNode = IN
bd_name = IN[0]
descr판별항목 = IN[1]
판별항목lv1 = descr판별항목[0]
판별항목lv2 = descr판별항목[1]
db = IN[2]


# Place your code below this line
def Is_newSheet(Sheet):
    
    hdrs_withIdx = dict(list(find_headersAtSheet(Sheet).items()) + list(find_headers_Building(Sheet, bd_name).items()))
    datasOnWMCodeCol = list(map(lambda x: x[hdrs_withIdx["Work Master Code"]], Sheet))
    
    p = re.compile('\w{8}-\w{5}')
    IsNewSheet = not(any(list(map(lambda x: p.match(str(x)), datasOnWMCodeCol))))
    
    
    return [IsNewSheet,datasOnWMCodeCol]
    
def find_headersAtSheet(Sheet):
    headers_Sheet = map(lambda x: [x[1].replace("\n",""),x[0]], filter(lambda x: x[1] != None, enumerate(Sheet[2])))
    res = dict(headers_Sheet)
    del res["_"]
    
    return res
    
def find_headers_Building(Sheet, bd_name):
    headers_bd = map(lambda x: [x[1].replace("\n",""),x[0]], filter(lambda x: x[1] != None, enumerate(Sheet[3])))
    headers_targetBD = list(filter(lambda x: x[0] == bd_name, headers_bd))
    res = {}
    res["targetBD"] = headers_targetBD[0][1]
    return res

def find_rangesAtSheet(Sheet, hdrs_withIdx, 판별항목):
    return find_range_by_columnItem_discrim(Sheet, hdrs_withIdx["Description"], 판별항목)

def get_DataOnRangesAtSheet(Sheet):
    
    hdrs_withIdx = dict(list(find_headersAtSheet(Sheet).items()) + list(find_headers_Building(Sheet, bd_name).items()))
    rgs_v_lv1 = list(map(lambda x: x[1], find_rangesAtSheet(Sheet, hdrs_withIdx, 판별항목lv1).values()))
    rgs_v_lv2 = list(map(lambda x: x[1], find_rangesAtSheet(Sheet, hdrs_withIdx, 판별항목lv2).values()))
    
    idxs_v_lv1 = list(map(lambda x: range(x[0],x[1]+1), rgs_v_lv1))

    datas_lv1 = []
    col_datas = list(map(lambda x: x[hdrs_withIdx["Description"]], Sheet))
    for rg in idxs_v_lv1:
        lv1_str = col_datas[rg[0]-1]
        tmp = []
        for i in rg:
            tmp.append([i, lv1_str, col_datas[i]])
        
        datas_lv1.append(tmp)

    datas_lv2 = []
    for rg in datas_lv1:
        tmp = []
        for idx,v in enumerate(rg):
            if v[2] == None:
                tmp.append([v[0],v[1],tmp[idx-1][2]])
            else:
                tmp.append(v)
        datas_lv2.append(tmp)

    flatten_res = list(chain(*datas_lv2))
    rres = itertools.groupby(flatten_res, lambda x: [x[1], x[2]])
    
    res = {}
    for k, g in rres:
        #print(list(g))
        removedfirstelem_g = list(g)[1:]
        res["_".join(k)] = [removedfirstelem_g[0][0],removedfirstelem_g[-1][0]]
        #res["_".join(k)] = removedfirstelem_g
    
    return res


hdrs_withIdx = dict(list(find_headersAtSheet(db).items()) + list(find_headers_Building(db, bd_name).items()))

if Is_newSheet(db)[0]:
    OUT = hdrs_withIdx, [Is_newSheet(db)[0],get_DataOnRangesAtSheet(db)]
else:
    OUT = hdrs_withIdx, Is_newSheet(db)
# ----------------------------------------
code_block_22 = CodeBlock(i=total_boq_데이터_파싱__ar_boq시트)
# ---------- code_block_22.designscript (3 lines) ----------
i[0];
i[1];
//구간 rIdx;
# ----------------------------------------
total_boq복사_및_경로_반환 = Python(IN[0]=code_block_21.TotalBOQ_path, IN[1]=code_block_22.out1)  # CPython3
# ---------- total_boq복사_및_경로_반환.python (35 lines) ----------
# Load the Python Standard and DesignScript Libraries
import sys
import clr
clr.AddReference('ProtoGeometry')
from Autodesk.DesignScript.Geometry import *
import datetime
import shutil

# The inputs to this node will be stored as a list in the IN variables.
dataEnteringNode = IN
origin_pathStr = IN[0]
IsNewSheet = IN[1][0]
# Place your code below this line

def copy_fromNewSheet():
    now = datetime.datetime.now()
    strList = origin_pathStr.split('.')
    
    add_str = now.strftime("%m%d-%I%M%S")
    add_res = "".join(["_",add_str,"."])
    strList.insert(1, add_res)
    res = "".join(strList)
    
    source = origin_pathStr
    destination = res
    shutil.copyfile(source, destination)
    
    return res

# Assign your output to the OUT variable.

if IsNewSheet:
    OUT = copy_fromNewSheet()
else:
    OUT = origin_pathStr
# ----------------------------------------
code_block_23 = CodeBlock(dict_groupBy_Sheet_WM=code_block_19) { dict_groupBy_Sheet_WM; }
wm별_계산결과_및_spec_정리_from_element = Python(IN[0]=code_block_23)  # CPython3; frozen
# ---------- wm별_계산결과_및_spec_정리_from_element.python (69 lines) ----------
# Load the Python Standard and DesignScript Libraries
import sys
import clr
clr.AddReference('ProtoGeometry')
from Autodesk.DesignScript.Geometry import *

import operator
from itertools import groupby
import copy

# The inputs to this node will be stored as a list in the IN variables.
dataEnteringNode = IN
elemDicts = IN[0]
# Place your code below this line
def extractCalcResult_forTotalBOQ(elemDicts):
    res = []
    for d in elemDicts:
        wms = d["wms"]
        for wm in wms:
            keys = ["SheetName", "rIDX", "Work Master Code", "Gauge Code", "wmSpecs", "Family Type Name", "calcResult"]
            vals = list(map(lambda x: wm[x],keys))
            k_v = list(zip(keys, vals))
            res_d = dict(k_v)
            if "Description" in wm.Keys:
                res_d["Description"] = wm["Description"]
            else:
                res_d["Description"] = ""
            res_d["wmcANDgauge"] = "".join([wm["Work Master Code"],wm["Gauge Code"]])
            res_d["UoM"] = wm["Unit"]
            res.append(res_d)
        
    return res

def make_dict_groupBy_WM(elemDicts):
    extractedDicts = extractCalcResult_forTotalBOQ(elemDicts)
    sortedDicts_WMC = sorted(extractedDicts, key=operator.itemgetter("wmcANDgauge"))
    grpDicts_WMC = groupby(sortedDicts_WMC, key=operator.itemgetter("wmcANDgauge"))
    
    res = []
    for k, g in grpDicts_WMC: 
        wmCode = k
        gg = copy.deepcopy(list(g))
        calcSum = round(sum(map(lambda x: x["calcResult"], gg)),3)
        wmSpecs = gg[0]["wmSpecs"]
        catStr = "_".join([wmSpecs[0],wmSpecs[1]])
        specOnly = list(filter(lambda x: x!=0, wmSpecs))[3:]
        addSpec = gg[0]["Description"]
        dict_res = {
            "catStr": catStr,
            "Work Master Code": wmCode,
            "Gauge Code": gg[0]["Gauge Code"],
            "Description": wmSpecs[2],
            "Spec.": "\n".join(specOnly),
            "Additional Spec.": addSpec,
            "calcVal": calcSum,
            "UoM": gg[0]["UoM"]
            #"wmSpecs": wmSpecs,
            }
        res.append(dict_res)
    
    
    return res

extDicts = extractCalcResult_forTotalBOQ(elemDicts)


# Assign your output to the OUT variable.
OUT = make_dict_groupBy_WM(elemDicts)
#OUT = sorted(set(map(lambda x: x["Work Master Code"], extDicts)))
# ----------------------------------------
wm별_spec_정리_from_family_list = Python(IN[0]=wm별_계산결과_및_spec_정리_from_element)  # CPython3; unwired: IN[1]
# ---------- wm별_spec_정리_from_family_list.python (136 lines) ----------
# Load the Python Standard and DesignScript Libraries
import sys
import clr
clr.AddReference('ProtoGeometry')
from Autodesk.DesignScript.Geometry import *

import operator
from itertools import groupby
from itertools import chain
import copy

# The inputs to this node will be stored as a list in the IN variables.
dataEnteringNode = IN
elemDicts = IN[0]
famTypeDict = IN[1]
wmDicts = list(chain(*famTypeDict.values()))
# Place your code below this line
def merge_dicts(*dict_args):
    """
    Given any number of dictionaries, shallow copy and merge into a new dict,
    precedence goes to key-value pairs in latter dictionaries.
    """
    result = {}
    for dictionary in dict_args:
        result.update(dictionary)
    return result

def getUnique_wmDicts(wmDicts):
    headers = wmDicts[0].Keys
    wmspec_headers = list(filter(lambda x: "Work C" in x or "Spec" in x, headers))
    noNeedKeys = ["Family Type Name", "Quantity", "rIDX", "Dynamo 물량산출식", "SheetName", "Q'ty Cal Type Tag"]
    def refineDicts(dicts, noNeedKeys):
        dicts_refined = []
        for d in dicts:
            new_d = {}
            keys,vals = d.Keys,d.Values
            keys_new = set(keys) - set(wmspec_headers)
            items = zip(keys, vals)  
            for k,v in items:
                if k not in noNeedKeys+wmspec_headers:
                    new_d[k] = v
                    new_d["wmSpecs"] = list(map(lambda x: d[x], wmspec_headers))
            dicts_refined.append(new_d)
        return dicts_refined
    wmDicts_refined = refineDicts(wmDicts, noNeedKeys)
        
    allWMcodes = list(map(lambda x: x["Work Master Code"], wmDicts_refined))
    uniqueWMcodes = set(allWMcodes)
    
    def getUnique(dicts, tgt_key):
        res = []
        tmp = []
        for d in dicts:
            if d[tgt_key] not in tmp:
                tmp.append(d[tgt_key])
                res.append(d)
        return res
    
    unique_wmDicts = getUnique(wmDicts_refined, "Work Master Code")

        
    return unique_wmDicts
    

    
def reformatDicts(wmDicts):
    res = []

    for wm in wmDicts:
        keys = ["Work Master Code", "Gauge Code", "wmSpecs"]
        vals = list(map(lambda x: wm[x],keys))
        items = list(zip(keys, vals))
        res_d = dict(items)
        
        if "Description" in wm.keys():
            res_d["Description"] = wm["Description"]
        else:
            res_d["Description"] = ""
        res_d["wmcANDgauge"] = "".join([wm["Work Master Code"],wm["Gauge Code"]])
        res_d["UoM"] = wm["Unit"]
        res.append(res_d)
        
    return res

def make_dict_groupBy_WM(wmDicts, elemDicts):
    unique_wmDicts = getUnique_wmDicts(wmDicts)
    reformated_dicts = reformatDicts(unique_wmDicts)
    sortedDicts_WMC = sorted(reformated_dicts, key=operator.itemgetter("wmcANDgauge"))
    grpDicts_WMC = groupby(sortedDicts_WMC, key=operator.itemgetter("wmcANDgauge"))
    
    wm_valDicts = {}
    for x in elemDicts:
        wm_valDicts[x["Work Master Code"]] = x["calcVal"]
    
    
    res = []
    for k, g in grpDicts_WMC: 
        wmCode = k
        gg = copy.deepcopy(list(g))
        wmSpecs = gg[0]["wmSpecs"]
        catStr = "_".join([wmSpecs[0],wmSpecs[1]])
        specOnly = list(filter(lambda x: x!=0, wmSpecs))[3:]
        addSpec = gg[0]["Description"]
        if wm_valDicts.get(k):
            dict_res = {
                "catStr": catStr,
                "Work Master Code": wmCode,
                "Gauge Code": gg[0]["Gauge Code"],
                "Description": wmSpecs[2],
                "Spec.": "\n".join(specOnly),
                "Additional Spec.": addSpec,
                "calcVal": wm_valDicts[k],
                "UoM": gg[0]["UoM"]
                #"wmSpecs": wmSpecs,
                }
        else:
            dict_res = {
                "catStr": catStr,
                "Work Master Code": wmCode,
                "Gauge Code": gg[0]["Gauge Code"],
                "Description": wmSpecs[2],
                "Spec.": "\n".join(specOnly),
                "Additional Spec.": addSpec,
                "calcVal": "",
                "UoM": gg[0]["UoM"]
                #"wmSpecs": wmSpecs,
                }
        res.append(dict_res)
    
    
    return res


# Assign your output to the OUT variable.
#OUT = make_dict_groupBy_WM(wmsList)
OUT = make_dict_groupBy_WM(wmDicts, elemDicts)
# ----------------------------------------
data_formatting_for_excel_export = Python(IN[0]=code_block_22.out1, IN[1]=wm별_spec_정리_from_family_list)  # CPython3
# ---------- data_formatting_for_excel_export.python (54 lines) ----------
# Load the Python Standard and DesignScript Libraries
import sys
import clr
clr.AddReference('ProtoGeometry')
from Autodesk.DesignScript.Geometry import *

from itertools import groupby
from itertools import chain

# The inputs to this node will be stored as a list in the IN variables.
dataEnteringNode = IN

IsNewSheet = IN[0][0]
inputDatas = IN[0][1]
wmsDicts = IN[1]
# Place your code below this line

def get_wmsGrped_sorted_idxed(rangeDicts, wmsDicts):
    wmsSorted = sorted(wmsDicts, key=lambda x: x["Work Master Code"])
    wmsGrped = groupby(wmsDicts, lambda x: x["catStr"])
    wmsGrped_sorted = []
    
    for k,v in wmsGrped:
        grp_sorted = sorted(list(v), key=lambda x: x["Work Master Code"])
        stt_idx = rangeDicts[k][0]
        length_grp = len(grp_sorted)
        idxs = range(stt_idx, stt_idx+length_grp)
        zip_grp_idxs = list(zip(idxs, grp_sorted))
        for i in zip_grp_idxs:
            d = i[1]
            d["rIDX"] = i[0]
        
        wmsGrped_sorted.append(grp_sorted)
        
    wmsGrped_sorted_idxed = list(chain(*wmsGrped_sorted))
    return wmsGrped_sorted_idxed

def match_DictWithIdx(datasOnWMCodeCol, wmsDicts):
    idxWithDatasOnWMCode = enumerate(datasOnWMCodeCol)
    for d in wmsDicts:
        d["rIDX"] = datasOnWMCodeCol.index(d["Work Master Code"])
        
    res = wmsDicts
    return res

# Assign your output to the OUT variable.
if IsNewSheet:
    rangeDicts = inputDatas
    res = get_wmsGrped_sorted_idxed(rangeDicts, wmsDicts)
else:
    datasOnWMCodeCol = inputDatas
    res = match_DictWithIdx(datasOnWMCodeCol, wmsDicts)

OUT = res
# ----------------------------------------
export_to_total_boq = Python(IN[0]=total_boq복사_및_경로_반환, IN[1]=code_block_21.sheetName, IN[2]=code_block_22.out0, IN[3]=code_block_22.out1, IN[4]=data_formatting_for_excel_export)  # CPython3; graph output
# ---------- export_to_total_boq.python (93 lines) ----------
# Load the Python Standard and DesignScript Libraries
import sys
import clr
clr.AddReference('ProtoGeometry')
from Autodesk.DesignScript.Geometry import *

from itertools import groupby

import DSOffice

# The inputs to this node will be stored as a list in the IN variables.
dataEnteringNode = IN
filePath = IN[0]
sheetName = IN[1]
hdrs_withIdx = IN[2]
IsNewSheet = IN[3][0]
dictList = IN[4]

# Place your code below this line
exportToExcel = DSOffice.Data.ExportToExcel
#print(hdrs_withIdx)

hdrsColIdxs = [
        hdrs_withIdx["Work Master Code"],
        hdrs_withIdx["Gauge Code"],
        hdrs_withIdx["Description"],
        hdrs_withIdx["Spec."],
        hdrs_withIdx["Additional Spec.(설계자 작성)"],
        hdrs_withIdx["Reference to(설계자 작성)"],
        hdrs_withIdx["UoM"],
        hdrs_withIdx["targetBD"],
            ]

def writeToNewSheet(dictList):
    dictList_grped = groupby(dictList, lambda x: x["catStr"])
    
    dictList_grpedList = []
    for k,grp in dictList_grped:
        dictList_grpedList.append(list(grp))
    
    def writeExcel(keys, startColhdr, grpedList):
        for i in dictList_grpedList:
            #keys = ["Work Master Code", "Gauge Code", "Description", "Spec.", "Additional Spec.", ]
            startCol = hdrs_withIdx[startColhdr]
            startRow = i[0]["rIDX"]
    
            datas = list(zip(*map(lambda y: map(lambda x: x.get(y), list(i)), keys)))
            #res.append(datas)
            exportToExcel(filePath, sheetName, startRow, startCol, datas)
    
    #keys1 = ["Work Master Code", "Gauge Code", "Description", "Spec.", "Additional Spec.", ]
    keys1 = ["Work Master Code", "Gauge Code", "Description", "Spec.", "Additional Spec.", "Reference to", "UoM"]
    #keys2 = ["UoM"]
    keys3 = ["calcVal"]
    
    writeExcel(keys1,"Work Master Code", dictList_grpedList)
    #writeExcel(keys2,"UoM", dictList_grpedList)
    writeExcel(keys3,"targetBD", dictList_grpedList)
    
    return dictList_grpedList
    
def writeToExistSheet(dictList):
    dictList_grped = groupby(dictList, lambda x: x["catStr"])
    
    dictList_grpedList = []
    for k,grp in dictList_grped:
        dictList_grpedList.append(list(grp))
    
    def writeExcel(keys,startColhdr, grpedList):
        for i in dictList_grpedList:
            #keys = ["Work Master Code", "Gauge Code", "Description", "Spec.", "Additional Spec.", ]
            startCol = hdrs_withIdx[startColhdr]
            startRow = i[0]["rIDX"]
    
            datas = list(zip(*map(lambda y: map(lambda x: x[y], list(i)), keys)))
            #res.append(datas)
            exportToExcel(filePath, sheetName, startRow, startCol, datas)
    
#    keys1 = ["Work Master Code", "Gauge Code", "Description", "Spec.", "Additional Spec.", ]
#    keys2 = ["UoM"]
    keys3 = ["calcVal"]
    
#    writeExcel(keys1,"Work Master Code", dictList_grpedList)
#    writeExcel(keys2,"UoM", dictList_grpedList)
    writeExcel(keys3,"targetBD", dictList_grpedList)
    
    return dictList_grpedList
# Assign your output to the OUT variable.

if IsNewSheet:
    OUT = writeToNewSheet(dictList)
else:
    OUT = writeToExistSheet(dictList)
# ----------------------------------------
code_block_24 = CodeBlock { "Steam Turbine Building"; "Gate House"; }

code_block_25 = CodeBlock(file_path=family_list_경로_입력) { file_path; }
code_block_26 = CodeBlock { famTypeDic; }  # unwired: famTypeDic
code_block_27 = CodeBlock()  # //레빗 프로젝트 단위 중 길이가 m 여야 한다
code_block_28 = CodeBlock(i=hCalc_FullCode) { i[0][0]; i[0][1]; }  # frozen

# group: 토공 형상 검토 및 DirectShape Revit 생성
custom_selection = CustomSelection("되메우기 형상", items={터파기 형상: "effExcaGeo", 되메우기 형상: "effBackfillGeo"})
categories_3 = Categories("OST_GenericModel")  # frozen
토공_형상_검토 = Python(IN[0]=custom_selection, IN[1]=code_block_28.out0, IN[2]=code_block_28.out1, IN[3]=categories_3)  # CPython3
# ---------- 토공_형상_검토.python (52 lines) ----------
# Load the Python Standard and DesignScript Libraries
import sys
import clr
clr.AddReference('ProtoGeometry')
from Autodesk.DesignScript.Geometry import *

clr.AddReference('RevitServices')
import RevitServices
from RevitServices.Persistence import DocumentManager
from RevitServices.Transactions import TransactionManager

import Revit

# The inputs to this node will be stored as a list in the IN variables.
dataEnteringNode = IN

tgt_key = IN[0]

elemDicts_eachEarth = IN[1]
shape_wholeEarth = IN[2]
directShapeCat = IN[3]

# Place your code below this line

def CreateDirectShapeByGeometry(geo, category):
    doc = DocumentManager.Instance.CurrentDBDocument
    uidoc=DocumentManager.Instance.CurrentUIApplication.ActiveUIDocument
    TransactionManager.Instance.EnsureInTransaction(doc)
    Revit.Elements.DirectShape.ByGeometry(geo, category)
    TransactionManager.Instance.TransactionTaskDone()

def createEarthWorkShape(tgt_key, elemDicts_eachEarth, shape_wholeEarth):
    dict_for_shape_wholeEarth = {
        "effExcaGeo": 0,
        "effBackfillGeo": 1
        }
    
    if shape_wholeEarth:
        res = shape_wholeEarth[dict_for_shape_wholeEarth[tgt_key]]
    else:
        onlyExcaDicts = list(filter(lambda x: tgt_key in x.keys(), elemDicts_eachEarth))
        res = Solid.ByUnion(list(map(lambda x: x[tgt_key], onlyExcaDicts)))
    return res



    
result = createEarthWorkShape(tgt_key, elemDicts_eachEarth, shape_wholeEarth)


# Assign your output to the OUT variable.
OUT = result#CreateDirectShapeByGeometry(res, directShapeCat)
# ----------------------------------------
byGeometry = DirectShape.ByGeometry(geometry=토공_형상_검토, category=categories_3)
color_palette = ColorPalette({R: 255, G: 20, B: 147, A: 255})
overrideColorInView = Element.OverrideColorInView(element=byGeometry, color=color_palette)
