# Dynamo graph hCalc_rA(20230825).dyn (Dynamo 2.16.1.2727)

# group: All Data in Excel
file_path = Filename(".\플랜트건축팀_BIM_팀 표준 Family List_Rev.0_SQ1_20230824.xlsx")
file_from_path = FileObject(path=file_path)
code_block = CodeBlock()
# ---------- code_block.designscript (9 lines) ----------
[
"물량Param",
"1.Floors",
"2.Roofs",
"3.Walls",
"4.St Fdn",
"5.St Col",
"6.St Framing"
];
# ----------------------------------------
boolean = BoolSelector(true)
importExcel = Data.ImportExcel(file=file_from_path, sheetName=code_block, showExcel=boolean)

# group: 위치검색용 String 화 데이터
string_from_object = FromObject(object=importExcel)

# group: 물량 파라미터시트 / 그 외 구분
deconstruct = List.Deconstruct(list=importExcel)

col_stt_end = CodeBlock { "D"; "-"; }
row_분할_기준_인덱스_산출 = Python(IN[0]=deconstruct.first, IN[1]=col_stt_end.out0, IN[2]=col_stt_end.out1)  # CPython3
# ---------- row_분할_기준_인덱스_산출.python (73 lines) ----------
# Load the Python Standard and DesignScript Libraries
import sys
import clr
clr.AddReference('ProtoGeometry')
from Autodesk.DesignScript.Geometry import *

from functools import reduce
from functools import partial
from string import ascii_lowercase

def getCharValue(s):
    # 베이스 케이스
    if not s:
        return 0
 
    value = 0
    # 입력 문자열을 대문자로 변환한 후 반복
    for ch in s:
        value = value * 26 + (ord(ch) - ord('A') + 1)
    return value
    
#################################Module For Functional Programing#############################################
curry = lambda f: lambda a,*args: f(a, *args) if (len(args)) else lambda *args: f(a, *args)

filter = curry(filter)
map = curry(map)

def _take(length, iter):
    res = []
    for a in iter:
        res.append(a)
        if len(res) == length:
            return res
        
take = curry(_take)
reduce = curry(reduce)

go = lambda *args: reduce(lambda a,f: f(a), args) ## 함수도 축약 가능 ##
##############################################################################################################

# The inputs to this node will be stored as a list in the IN variables.
dataEnteringNode = IN
db = IN[0]
col_idx = getCharValue(IN[1])-2
#row_stt = IN[2]-1
sep_rule = IN[2]


# Place your code below this line
def find_IsInStr(target, str):
    if target == None or str == None:
        pass
    else:
        res = target in str
        return res

def find_range_by_columnItem(db, col_idx, sep_rule):
    tdb = list(map(lambda x: x[col_idx], db))
    last_idx_tdb = len(tdb)-1
    tdb_enum = enumerate(tdb)
    res = list(filter(lambda x: find_IsInStr(sep_rule, x[1]), tdb_enum))
    endidxs_tmp= list(map(lambda x: x[0]-1,res))
    endidxs_tmp.pop(0)
    endidxs = endidxs_tmp + [last_idx_tdb]
    a = list(map(lambda x: x[1],res))
    b = list(map(lambda x: x[0],res))
    c = endidxs
    result = zip(a,b,c)
    return result

# Assign your output to the OUT variable.
#OUT = col_idx
OUT = find_range_by_columnItem(db, col_idx, sep_rule)
# ----------------------------------------
deconstruct_2 = List.Deconstruct(list=row_분할_기준_인덱스_산출@L2)
code_block_2 = CodeBlock(Qlink=deconstruct_2.first) { Qlink; }
code_block_3 = CodeBlock(i=deconstruct.first) { i; }

# group: 패밀리 인스턴스 매개변수
code_block_4 = CodeBlock { 12; }
getItemAtIndex = List.GetItemAtIndex(list=code_block_3@L2, index=code_block_4)
firstItem = List.FirstItem(list=deconstruct_2.rest@L2)
lastItem = List.LastItem(list=deconstruct_2.rest@L2)
code_block_5 = CodeBlock(i=lastItem) { i+1; }
slice = List.Slice(list=getItemAtIndex, start=firstItem, end=code_block_5)
string_from_object_2 = FromObject(object=slice)

# group: 산출수식 약자
code_block_6 = CodeBlock { 5; }
getItemAtIndex_2 = List.GetItemAtIndex(list=code_block_3@L2, index=code_block_6)
firstItem_2 = List.FirstItem(list=deconstruct_2.rest@L2)
lastItem_2 = List.LastItem(list=deconstruct_2.rest@L2)
code_block_7 = CodeBlock(i=lastItem_2) { i+1; }
slice_2 = List.Slice(list=getItemAtIndex_2, start=firstItem_2, end=code_block_7)
string_from_object_3 = FromObject(object=slice_2)

# group: 사용자 입력값
code_block_8 = CodeBlock { 12; }
getItemAtIndex_3 = List.GetItemAtIndex(list=code_block_3@L2, index=code_block_8)
firstItem_3 = List.FirstItem(list=deconstruct_2.rest@L2)
lastItem_3 = List.LastItem(list=deconstruct_2.rest@L2)
code_block_9 = CodeBlock(i=lastItem_3) { i+1; }
slice_3 = List.Slice(list=getItemAtIndex_3, start=firstItem_3, end=code_block_9)
string_from_object_4 = FromObject(object=slice_3)

# group: 패밀리 타입 매개변수
code_block_10 = CodeBlock { 11; }
getItemAtIndex_4 = List.GetItemAtIndex(list=code_block_3@L2, index=code_block_10)
firstItem_4 = List.FirstItem(list=deconstruct_2.rest@L2)
lastItem_4 = List.LastItem(list=deconstruct_2.rest@L2)
code_block_11 = CodeBlock(i=lastItem_4) { i+1; }
slice_4 = List.Slice(list=getItemAtIndex_4, start=firstItem_4, end=code_block_11)
string_from_object_5 = FromObject(object=slice_4)

code_block_12 = CodeBlock { "a * v"; }
code_block_13 = CodeBlock { ["a","v"]; }
code_block_14 = CodeBlock { [15,63]; }
evaluateFormula = Math.EvaluateFormula(formulaString=code_block_12, parameters=code_block_13, arguments=code_block_14)

# group: All Elements in Revit
all_elementsexceptrails = Python()  # CPython3; unwired: IN[0]
# ---------- all_elementsexceptrails.python (51 lines) ----------
# Load the Python Standard and DesignScript Libraries
import sys
import clr
clr.AddReference('ProtoGeometry')
from Autodesk.DesignScript.Geometry import *

clr.AddReference('RevitAPI')
from Autodesk.Revit.DB import *
import Autodesk

clr.AddReference('RevitServices')
import RevitServices
from RevitServices.Persistence import DocumentManager
doc = DocumentManager.Instance.CurrentDBDocument

def get_all_BIC():

    db = [
    Autodesk.Revit.DB.BuiltInCategory.OST_Floors,
    Autodesk.Revit.DB.BuiltInCategory.OST_Roofs,
    Autodesk.Revit.DB.BuiltInCategory.OST_Walls,
    Autodesk.Revit.DB.BuiltInCategory.OST_StructuralFoundation,
    Autodesk.Revit.DB.BuiltInCategory.OST_StructuralColumns,
    Autodesk.Revit.DB.BuiltInCategory.OST_StructuralFraming,
    Autodesk.Revit.DB.BuiltInCategory.OST_Ceilings,
    Autodesk.Revit.DB.BuiltInCategory.OST_Doors,
    Autodesk.Revit.DB.BuiltInCategory.OST_Windows,
    Autodesk.Revit.DB.BuiltInCategory.OST_Stairs,
    #Autodesk.Revit.DB.BuiltInCategory.OST_Railings,
    ]
    return db
    
def get_allElems(doc):
    bics = get_all_BIC()
    
    def getElems(x):
        collector = FilteredElementCollector(doc)
        res = collector.OfCategory(x).WhereElementIsNotElementType().ToElements()
        return res

    def getRailElems(x):
        collector = FilteredElementCollector(doc)
        res = collector.OfCategory(x).WhereElementIsNotElementType()
        return res

    res = map(getElems, bics)
#    res = getRailElems(Autodesk.Revit.DB.BuiltInCategory.OST_RailingSystemRail)
    return res


OUT = get_allElems(doc)
# ----------------------------------------
categories = Categories("OST_StairsRailing")
all_elements_of_category = ElementsOfCategory(Category=categories)
list_create = List.Create(item0=all_elements_of_category)
join = List.Join(list0=all_elementsexceptrails, list1=list_create)

code_block_15 = CodeBlock(i=join) { i[0]; }
code_block_16 = CodeBlock { "Area"; }
getParameterValueByName = Element.GetParameterValueByName(element=code_block_15, parameterName=code_block_16)
code_block_17 = CodeBlock(i=deconstruct.first) { i; }
floors = CodeBlock(i=deconstruct.rest) { i[0]; }
transpose = List.Transpose(lists=floors)
col_stt_end_2 = CodeBlock { "E"; "-"; }
row_분할_기준_인덱스_산출_2 = Python(IN[0]=floors, IN[1]=col_stt_end_2.out0, IN[2]=col_stt_end_2.out1)  # CPython3; same code as row_분할_기준_인덱스_산출
deconstruct_3 = List.Deconstruct(list=row_분할_기준_인덱스_산출_2@L2)

# group: 패밀리 타입 매개변수
firstItem_5 = List.FirstItem(list=deconstruct_3.rest@L2)
lastItem_5 = List.LastItem(list=deconstruct_3.rest@L2)
code_block_18 = CodeBlock(i=lastItem_5) { i+1; }
slice_5 = List.Slice(list=transpose@L2, start=firstItem_5, end=code_block_18)
string_from_object_6 = FromObject(object=slice_5)

code_block_19 = CodeBlock(i=slice_5) { i[28]; }
boolean_2 = BoolSelector(false)
clean = List.Clean(list=code_block_19, preserveIndices=boolean_2)
code_block_20 = CodeBlock { 0; 2; }
remove = String.Remove(string=clean, startIndex=code_block_20.out0, count=code_block_20.out1)
code_block_21 = CodeBlock()
# ---------- code_block_21.designscript (5 lines) ----------
[
"a",
"v",
"re"
];
# ----------------------------------------
code_block_22 = CodeBlock { [1,2,3]; }
evaluateFormula_2 = Math.EvaluateFormula(formulaString=remove, parameters=code_block_21, arguments=code_block_22)
string_from_object_7 = FromObject(object=code_block_19)
uniqueItems = List.UniqueItems(list=string_from_object_7@L2)
code_block_23 = CodeBlock { "a * v"; }
code_block_24 = CodeBlock { ["a","v"]; }
code_block_25 = CodeBlock { [15,63]; }
evaluateFormula_3 = Math.EvaluateFormula(formulaString=code_block_23, parameters=code_block_24, arguments=code_block_25)
code_block_26 = CodeBlock()  # //이부분 완성하고 python화 해서 카테고리 별 사용으로 가자
