# Dynamo graph hCalc_rA(20230904).dyn (Dynamo 2.16.1.2727)

# group: Math.EvaluateFormula 테스트
code_block = CodeBlock { "a * v"; }
code_block_2 = CodeBlock { ["a","v"]; }
code_block_3 = CodeBlock { [15,63]; }
evaluateFormula = Math.EvaluateFormula(formulaString=code_block, parameters=code_block_2, arguments=code_block_3)

code_block_4 = CodeBlock()
# ---------- code_block_4.designscript (11 lines) ----------
// 부재별로 최종 정리될 서브 리스트 구성 :

// 패밀리 Type 코드

// WM 코드들

// 수식

// 수식 참여 문자

// 수식 참여 문자의 값 (엑셀 입력값 + 레빗 인스턴스 속성 값 + 레빗 타입 속성 값)
# ----------------------------------------

# group: All Data in Excel
file_path = Filename(".\플랜트건축팀_BIM_팀 표준 Family List_Rev.0_SQ2_박기범_20230904.xlsx")
file_from_path = FileObject(path=file_path)
code_block_5 = CodeBlock()
# ---------- code_block_5.designscript (15 lines) ----------
[
"물량Param",
"1.Floors",
"2.Roofs",
"3.Walls",
"4.St Fdn",
"5.St Col",
"6.St Framing",
"7.Ceilings",
"8.Doors",
"9.Windows",
"10.Stairs",
"11.Railings"
//,"13.Generic"
];
# ----------------------------------------
boolean = BoolSelector(true)
importExcel = Data.ImportExcel(file=file_from_path, sheetName=code_block_5, showExcel=boolean)
deconstruct = List.Deconstruct(list=code_block_5)

family_list_데이터_파싱_category_시트 = Python(IN[0]=importExcel, IN[1]=deconstruct.rest)  # CPython3
# ---------- family_list_데이터_파싱_category_시트.python (143 lines) ----------
# Load the Python Standard and DesignScript Libraries
import sys
import clr
clr.AddReference('ProtoGeometry')
from Autodesk.DesignScript.Geometry import *

from functools import reduce
from functools import partial
from string import ascii_lowercase

def getCharValue(s):
    # 베이스 케이스
    if not s:
        return 0
 
    value = 0
    # 입력 문자열을 대문자로 변환한 후 반복
    for ch in s:
        value = value * 26 + (ord(ch) - ord('A') + 1)
    return value
    
#################################Module For Functional Programing#############################################
curry = lambda f: lambda a,*args: f(a, *args) if (len(args)) else lambda *args: f(a, *args)

filter = curry(filter)
map = curry(map)

def _take(length, iter):
    res = []
    for a in iter:
        res.append(a)
        if len(res) == length:
            return res
        
take = curry(_take)
reduce = curry(reduce)

go = lambda *args: reduce(lambda a,f: f(a), args) ## 함수도 축약 가능 ##
##############################################################################################################
def find_IsInStr(target, str):
    if target == None or str == None:
        pass
    else:
        res = target in str
        return res

def find_range_by_columnItem(db, col_idx, sep_rule):
    tdb = list(map(lambda x: x[col_idx], db))
    last_idx_tdb = len(tdb)-1
    tdb_enum = enumerate(tdb)
    res = list(filter(lambda x: find_IsInStr(sep_rule, x[1]), tdb_enum))
    endidxs_tmp= list(map(lambda x: x[0]-1,res))
    #endidxs_tmp= list(map(lambda x: x[0],res))
    endidxs_tmp.pop(0)
    endidxs = endidxs_tmp + [last_idx_tdb]
    famTypeNames = list(map(lambda x: x[1],res))
    famTypeNamesIdxs = list(map(lambda x: x[0],res))
    rangeSttIdxs = list(map(lambda x: x[0]+1,res))
    rangeEndIdxs = endidxs
    result = dict(zip(famTypeNames, zip(famTypeNamesIdxs, zip(rangeSttIdxs,rangeEndIdxs))))
    return result

# The inputs to this node will be stored as a list in the IN variables.
dataEnteringNode = IN
db = IN[0]
allCatSheetsNames =IN[1]
#col_idx = getCharValue(IN[2])-2
#sep_rule = IN[3]

paramSheet = db[0]
allCatSheets = db[1:]

# Place your code below this line

def find_headersAtCatSheet(catSheet):
    headers_CatSheet = map(lambda x: [x[1].replace("\n",""),x[0]], filter(lambda x: x[1] != None, enumerate(catSheet[1])))
    
    return dict(headers_CatSheet)

def find_rangesAtCatSheet(catSheet, hdrs_withIdx):
    return find_range_by_columnItem(catSheet, hdrs_withIdx["Family Type Name"], "H_")

def get_DataOnRangesAtCatSheet(catSheet): 
    hdrs_withIdx = find_headersAtCatSheet(catSheet)
    title_idx = map(lambda x: x[0], find_rangesAtCatSheet(catSheet, hdrs_withIdx).values())
    calcType_colDatas = list(map(lambda x: x[hdrs_withIdx["Q'ty Cal Type Tag"]], catSheet))
    calcTypes = list(map(lambda x: calcType_colDatas[x], title_idx))
    rgs_v = list(map(lambda x: x[1], find_rangesAtCatSheet(catSheet, hdrs_withIdx).values()))
    rgs_k = list(map(lambda x: x, find_rangesAtCatSheet(catSheet, hdrs_withIdx).keys()))
    
    hdrs_v = list(hdrs_withIdx.values())
    hdrs_k = list(hdrs_withIdx.keys())
    #tagDatas = list(zip(rgs_k,calcTypes))
    
    datas_allFamType = list(map(lambda x: catSheet[x[0]-1:x[1]], rgs_v))
    #datas_allFamType = list(zip(tagDatas, datas_allFamType_))
    
    def setDict_OnEachFamType(data_famType):  ## 최종적으로 산출식 없는 것 걸러내기 추가해야 함
        titleData = data_famType.pop(0)
        famTypeName = titleData[hdrs_withIdx["Family Type Name"]]
        calcTypeName = titleData[hdrs_withIdx["Q'ty Cal Type Tag"]]
        data_famType_noneless = list(filter(lambda x: x[5] != None, data_famType))
        ## WM row 별 header명 과 짝짓기
        data_withHdrsIdx = list(map(lambda y: list(map(lambda x: y[x], hdrs_v)), data_famType_noneless))
        dict_ = list(map(lambda x: dict(zip(hdrs_k, x)), data_withHdrsIdx))
        dicts_noneless = list(map(lambda y: dict(filter(lambda x: x[1]!=None, y.items())),dict_))
        ## dict_gauge, 물량산출식 없는 항목 처리
        dicts_final = []
        needDefault_ColName = "Guage Code"
        noneRemove_ColName = "Dynamo 물량산출식"
        for d in dicts_noneless:
            d["Family Type Name"] = famTypeName
            if calcTypeName == None:
                pass            
            elif noneRemove_ColName in d.keys():
                d["Q'ty Cal Type Tag"] = calcTypeName
                d[needDefault_ColName] = ""
                dicts_final.append(d)

        
        return dicts_final
        
    dicts_allFamType = list(map(lambda x: setDict_OnEachFamType(x), datas_allFamType))
    ds_famTypesAtCatSheet = dict(zip(rgs_k, dicts_allFamType))
    ds_famTypesAtCatSheet_effCalcType = dict(filter(lambda x: all(list(map(lambda i: "Q'ty Cal Type Tag" in i, x[1]))), list(ds_famTypesAtCatSheet.items())))
    ds_famTypesAtCatSheet_noneless = dict(filter(lambda x: len(list(x[1]))!=0, list(ds_famTypesAtCatSheet_effCalcType.items())))
    
    return ds_famTypesAtCatSheet_noneless

## 시트별 딕셔너리가 아닌, 하나의 딕셔너리에 때려박는 포맷으로도 결과값 만들어 두기
dataOnRanges_allCat = list(map(get_DataOnRangesAtCatSheet, allCatSheets))
dicts_allCat = {}
for d in dataOnRanges_allCat:
    dict_k_v = d.items()
    for k,v in dict_k_v:
        dicts_allCat[k] = v

# Assign your output to the OUT variable.

#OUT = find_rangesAtCatSheet(allCatSheets[1])
#OUT = find_headersAtCatSheet(allCatSheets[1])
#OUT = get_DataOnRangesAtCatSheet(allCatSheets[0])
OUT = dicts_allCat
# ----------------------------------------

# group: 검증용
values = DesignScript.Builtin.Dictionary.Values(dictionary=family_list_데이터_파싱_category_시트)
code_block_6 = CodeBlock { "Q'ty Cal Type Tag"; "Work Master Code"; "Dynamo 물량산출식"; }
valueAtKey = DesignScript.Builtin.Dictionary.ValueAtKey(dictionary=values@L2, key=code_block_6.out1)
valueAtKey_2 = DesignScript.Builtin.Dictionary.ValueAtKey(dictionary=values@L2, key=code_block_6.out0)
valueAtKey_3 = DesignScript.Builtin.Dictionary.ValueAtKey(dictionary=values@L3, key=code_block_6.out2)
components = DesignScript.Builtin.Dictionary.Components(dictionary=family_list_데이터_파싱_category_시트)
flatten = List.Flatten(list=components.keys)
flatten_2 = List.Flatten(list=components.values@L3)
byKeysValues = DesignScript.Builtin.Dictionary.ByKeysValues(keys=flatten, values=flatten_2@L1)
code_block_7 = CodeBlock { "Family Type Name"; }
valueAtKey_4 = DesignScript.Builtin.Dictionary.ValueAtKey(dictionary=components.values, key=code_block_7)

family_list_데이터_파싱_물량param_시트 = Python(IN[0]=importExcel, IN[1]=deconstruct.first)  # CPython3
# ---------- family_list_데이터_파싱_물량param_시트.python (131 lines) ----------
# Load the Python Standard and DesignScript Libraries
import sys
import clr
clr.AddReference('ProtoGeometry')
from Autodesk.DesignScript.Geometry import *

from functools import reduce
from functools import partial
from string import ascii_lowercase

def getCharValue(s):
    # 베이스 케이스
    if not s:
        return 0
 
    value = 0
    # 입력 문자열을 대문자로 변환한 후 반복
    for ch in s:
        value = value * 26 + (ord(ch) - ord('A') + 1)
    return value
    
#################################Module For Functional Programing#############################################
curry = lambda f: lambda a,*args: f(a, *args) if (len(args)) else lambda *args: f(a, *args)

filter = curry(filter)
map = curry(map)

def _take(length, iter):
    res = []
    for a in iter:
        res.append(a)
        if len(res) == length:
            return res
        
take = curry(_take)
reduce = curry(reduce)

go = lambda *args: reduce(lambda a,f: f(a), args) ## 함수도 축약 가능 ##
##############################################################################################################
def find_IsInStr(target, str):
    if target == None or str == None:
        pass
    else:
        res = target in str
        return res

def find_range_by_columnItem(db, col_idx, sep_rule):
    tdb = list(map(lambda x: x[col_idx], db))
    last_idx_tdb = len(tdb)-1
    tdb_enum = enumerate(tdb)
    res = list(filter(lambda x: find_IsInStr(sep_rule, x[1]), tdb_enum))
    endidxs_tmp= list(map(lambda x: x[0]-1,res))
    #endidxs_tmp= list(map(lambda x: x[0],res))
    endidxs_tmp.pop(0)
    endidxs = endidxs_tmp + [last_idx_tdb]
    famTypeNames = list(map(lambda x: x[1],res))
    famTypeNamesIdxs = list(map(lambda x: x[0],res))
    rangeSttIdxs = list(map(lambda x: x[0]+1,res))
    rangeEndIdxs = endidxs
    result = dict(zip(famTypeNames, zip(famTypeNamesIdxs, zip(rangeSttIdxs,rangeEndIdxs))))
    return result

# The inputs to this node will be stored as a list in the IN variables.
dataEnteringNode = IN
db = IN[0]
allCatSheetsNames =IN[1]
#col_idx = getCharValue(IN[2])-2
#sep_rule = IN[3]

paramSheet = db[0]
allCatSheets = db[1:]

# Place your code below this line

def find_headersAtCatSheet(catSheet):
    headers_CatSheet = map(lambda x: [x[1].replace("\n",""),x[0]], filter(lambda x: x[1] != None, enumerate(catSheet[1])))
    
    return dict(headers_CatSheet)

def find_rangesAtCatSheet(catSheet, hdrs_withIdx):
    return find_range_by_columnItem(catSheet, hdrs_withIdx["Q'ty Cal Type Tag"], "-")

def get_DataOnRangesAtCatSheet(Sheet):
    hdrs_withIdx = find_headersAtCatSheet(Sheet)
    title_idx = map(lambda x: x[0], find_rangesAtCatSheet(Sheet, hdrs_withIdx).values())
    calcType_colDatas = list(map(lambda x: x[hdrs_withIdx["Q'ty Cal Type Tag"]], Sheet))
    calcTypes = list(map(lambda x: calcType_colDatas[x], title_idx))
    rgs_v = list(map(lambda x: x[1], find_rangesAtCatSheet(Sheet, hdrs_withIdx).values()))
    rgs_k = list(map(lambda x: x, find_rangesAtCatSheet(Sheet, hdrs_withIdx).keys()))
    
    hdrs_v = list(hdrs_withIdx.values())
    hdrs_k = list(hdrs_withIdx.keys())
    eff_hdrs_v = hdrs_v[2:]
    eff_hdrs_k = hdrs_k[2:]
    
    datas_allCalType = list(map(lambda x: Sheet[x[0]-1:x[1]], rgs_v))
    #datas_allFamType = list(zip(tagDatas, datas_allFamType_))
    
    def setDict_OnEachCalType(data_calType):
        calcTypeName = data_calType[0][2]
        data_calType_noneless = list(filter(lambda x: x[hdrs_withIdx["항목"]] != None, data_calType))
#        ## WM row 별 header명 과 짝짓기
        data_withHdrsIdx = list(map(lambda y: list(map(lambda x: y[x], eff_hdrs_v)), data_calType_noneless))
        dict_ = list(map(lambda x: dict(zip(eff_hdrs_k, x)), data_withHdrsIdx))
        dicts_noneless = list(map(lambda y: dict(filter(lambda x: x[1]!=None, y.items())),dict_))
#        ## dict_Cal Type 입력처리
        targetColName = "Q'ty Cal Type Tag"
        dicts_finalNoneless = []
        for d in dicts_noneless:
            d["Q'ty Cal Type Tag"] = calcTypeName
            
            if "입력값" in d.keys():
                d["applyForCalc"] = d["입력값"]
                dicts_finalNoneless.append(d)
            elif "패밀리 매개변수(from Revit) 영문판" in d.keys():
                d["applyForCalc"] = d["패밀리 매개변수(from Revit) 영문판"]
                dicts_finalNoneless.append(d)
            else:
                pass
        
        return {calcTypeName: dicts_finalNoneless}
        
    return map(setDict_OnEachCalType, datas_allCalType) #datas_allCalType #
    
#dataOnRanges_allCat = map(get_DataOnRangesAtCatSheet, allCatSheets)
# Assign your output to the OUT variable.

#OUT = find_rangesAtCatSheet(allCatSheets[1])
#OUT = find_headersAtCatSheet(allCatSheets[1])
OUT = get_DataOnRangesAtCatSheet(paramSheet)
#OUT = dataOnRanges_allCat
# ----------------------------------------
values_2 = DesignScript.Builtin.Dictionary.Values(dictionary=family_list_데이터_파싱_물량param_시트)
code_block_8 = CodeBlock { "applyForCalc"; }
valueAtKey_5 = DesignScript.Builtin.Dictionary.ValueAtKey(dictionary=values_2@L2, key=code_block_8)
code_block_9 = CodeBlock()
# ---------- code_block_9.designscript (3 lines) ----------
//모델링 부재랑 만났을때,
//"applyForCalc값이 숫자인 경우는 바로 적용
//숫자가 아닌 경우는 파라미터 값 소환,
# ----------------------------------------
code_block_10 = CodeBlock()
# ---------- code_block_10.designscript (10 lines) ----------
//case


// CASE 1. 입력값과 매개변수 사용하여 수식 계산

// CASE 2. 입력값과 매개변수 사용하여 다이나모 알고리즘 계산


// >>> 레빗 부재 별로 패밀리 타입 엑셀 시트 짝지을때,
// applyForCalc값 중 매개 변수 에 해당 하는 값을 업데이트 하여 딕셔너리 갱신
# ----------------------------------------

# group: All Elements in Revit
all_elementsexceptrails = Python()  # CPython3; unwired: IN[0]
# ---------- all_elementsexceptrails.python (51 lines) ----------
# Load the Python Standard and DesignScript Libraries
import sys
import clr
clr.AddReference('ProtoGeometry')
from Autodesk.DesignScript.Geometry import *

clr.AddReference('RevitAPI')
from Autodesk.Revit.DB import *
import Autodesk

clr.AddReference('RevitServices')
import RevitServices
from RevitServices.Persistence import DocumentManager
doc = DocumentManager.Instance.CurrentDBDocument

def get_all_BIC():

    db = [
    Autodesk.Revit.DB.BuiltInCategory.OST_Floors,
    Autodesk.Revit.DB.BuiltInCategory.OST_Roofs,
    Autodesk.Revit.DB.BuiltInCategory.OST_Walls,
    Autodesk.Revit.DB.BuiltInCategory.OST_StructuralFoundation,
    Autodesk.Revit.DB.BuiltInCategory.OST_StructuralColumns,
    Autodesk.Revit.DB.BuiltInCategory.OST_StructuralFraming,
    Autodesk.Revit.DB.BuiltInCategory.OST_Ceilings,
    Autodesk.Revit.DB.BuiltInCategory.OST_Doors,
    Autodesk.Revit.DB.BuiltInCategory.OST_Windows,
    Autodesk.Revit.DB.BuiltInCategory.OST_Stairs,
    #Autodesk.Revit.DB.BuiltInCategory.OST_Railings,
    ]
    return db
    
def get_allElems(doc):
    bics = get_all_BIC()
    
    def getElems(x):
        collector = FilteredElementCollector(doc)
        res = collector.OfCategory(x).WhereElementIsNotElementType().ToElements()
        return res

    def getRailElems(x):
        collector = FilteredElementCollector(doc)
        res = collector.OfCategory(x).WhereElementIsNotElementType()
        return res

    res = map(getElems, bics)
#    res = getRailElems(Autodesk.Revit.DB.BuiltInCategory.OST_RailingSystemRail)
    return res


OUT = get_allElems(doc)
# ----------------------------------------
categories = Categories("OST_StairsRailing")
all_elements_of_category = ElementsOfCategory(Category=categories)
list_create = List.Create(item0=all_elements_of_category)
join = List.Join(list0=all_elementsexceptrails, list1=list_create)

flatten_3 = List.Flatten(list=join)
code_block_11 = CodeBlock { "Type"; "Type Name"; }
getParameterValueByName = Element.GetParameterValueByName(element=flatten_3, parameterName=code_block_11.out0)
getParameterValueByName_2 = Element.GetParameterValueByName(element=getParameterValueByName, parameterName=code_block_11.out1)
valueAtKey_6 = DesignScript.Builtin.Dictionary.ValueAtKey(dictionary=family_list_데이터_파싱_category_시트, key=getParameterValueByName_2)
code_block_12 = CodeBlock { false; }
clean = List.Clean(list=valueAtKey_6, preserveIndices=code_block_12)
code_block_13 = CodeBlock { "Work Master Code"; "Family Type Name"; "Description"; }
valueAtKey_7 = DesignScript.Builtin.Dictionary.ValueAtKey(dictionary=clean, key=code_block_13.out0)
valueAtKey_8 = DesignScript.Builtin.Dictionary.ValueAtKey(dictionary=clean, key=code_block_13.out2)
string_from_object = FromObject(object=valueAtKey_8)
code_block_14 = CodeBlock { "null"; ""; }
replace = String.Replace(string=string_from_object, searchFor=code_block_14.out0, replaceWith=code_block_14.out1)
join_2 = List.Join(list0=valueAtKey_7, list1=replace)
