# Dynamo graph hCalc_rD(20231012).dyn (Dynamo 2.16.1.2727)
# author: MK Jang
# Auto Calculating the Quantities of each Element As per the Family List

code_block = CodeBlock()
# ---------- code_block.designscript (3 lines) ----------
//모델링 부재랑 만났을때,
//"applyForCalc값이 숫자인 경우는 바로 적용
//숫자가 아닌 경우는 파라미터 값 소환,
# ----------------------------------------
code_block_2 = CodeBlock()
# ---------- code_block_2.designscript (2 lines) ----------
// >>> 레빗 부재 별로 패밀리 타입 엑셀 시트 짝지을때,
// applyForCalc값 중 매개 변수 에 해당 하는 값을 업데이트 하여 딕셔너리 갱신
# ----------------------------------------
code_block_3 = CodeBlock()
# ---------- code_block_3.designscript (9 lines) ----------
// 최종적으로는

// 부재(FamilyType) 별 WM 항목 마다
// 1. 물량산출식
// 2. 산출식 참여 약자 목록 []
// 3. 약자별 대입 값 목록 []


// 이렇게 정리가 되어있어야 한다.
# ----------------------------------------

# group: All Data in Excel
family_list_경로_입력 = Filename(".\플랜트건축팀_BIM_팀 표준 Family List_Rev.0_SQ3_박기범_20230913.xlsx")  # graph input
file_from_path = FileObject(path=family_list_경로_입력)
code_block_4 = CodeBlock()
# ---------- code_block_4.designscript (16 lines) ----------
[
"WM-AR",
"물량Param",
"1.Floors",
"2.Roofs",
"3.Walls",
"4.St Fdn",
"5.St Col",
"6.St Framing",
"7.Ceilings",
"8.Doors",
"9.Windows",
"10.Stairs",
"11.Railings"
//,"13.Generic"
];
# ----------------------------------------
boolean = BoolSelector(true)
importExcel = Data.ImportExcel(file=file_from_path, sheetName=code_block_4, showExcel=boolean)
deconstruct = List.Deconstruct(list=code_block_4)
deconstruct_2 = List.Deconstruct(list=deconstruct.rest)

# group: Excel data dictionarization
deconstruct_3 = List.Deconstruct(list=importExcel)
lang_mode_영_한_select = BoolSelector(true)
family_list_데이터_파싱_물량param_시트 = Python(IN[0]=deconstruct_3.rest, IN[1]=deconstruct_2.first, IN[2]=lang_mode_영_한_select)  # CPython3
# ---------- family_list_데이터_파싱_물량param_시트.python (133 lines) ----------
# Load the Python Standard and DesignScript Libraries
import sys
import clr
clr.AddReference('ProtoGeometry')
from Autodesk.DesignScript.Geometry import *

from functools import reduce
from functools import partial
from string import ascii_lowercase

def getCharValue(s):
    # 베이스 케이스
    if not s:
        return 0
 
    value = 0
    # 입력 문자열을 대문자로 변환한 후 반복
    for ch in s:
        value = value * 26 + (ord(ch) - ord('A') + 1)
    return value
    
#################################Module For Functional Programing#############################################
curry = lambda f: lambda a,*args: f(a, *args) if (len(args)) else lambda *args: f(a, *args)

filter = curry(filter)
map = curry(map)

def _take(length, iter):
    res = []
    for a in iter:
        res.append(a)
        if len(res) == length:
            return res
        
take = curry(_take)
reduce = curry(reduce)

go = lambda *args: reduce(lambda a,f: f(a), args) ## 함수도 축약 가능 ##
##############################################################################################################
def find_IsInStr(target, str):
    if target == None or str == None:
        pass
    else:
        res = target in str
        return res

def find_range_by_columnItem(db, col_idx, sep_rule):
    tdb = list(map(lambda x: x[col_idx], db))
    last_idx_tdb = len(tdb)-1
    tdb_enum = enumerate(tdb)
    res = list(filter(lambda x: find_IsInStr(sep_rule, x[1]), tdb_enum))
    endidxs_tmp= list(map(lambda x: x[0]-1,res))
    #endidxs_tmp= list(map(lambda x: x[0],res))
    endidxs_tmp.pop(0)
    endidxs = endidxs_tmp + [last_idx_tdb]
    famTypeNames = list(map(lambda x: x[1],res))
    famTypeNamesIdxs = list(map(lambda x: x[0],res))
    rangeSttIdxs = list(map(lambda x: x[0]+1,res))
    rangeEndIdxs = endidxs
    result = dict(zip(famTypeNames, zip(famTypeNamesIdxs, zip(rangeSttIdxs,rangeEndIdxs))))
    return result

# The inputs to this node will be stored as a list in the IN variables.
dataEnteringNode = IN
db = IN[0]
allCatSheetsNames =IN[1]
lang_mode = IN[2]

paramSheet = db[0]
allCatSheets = db[1:]

# Place your code below this line

def find_headersAtCatSheet(catSheet):
    headers_CatSheet = map(lambda x: [x[1].replace("\n",""),x[0]], filter(lambda x: x[1] != None, enumerate(catSheet[1])))
    
    return dict(headers_CatSheet)

def find_rangesAtCatSheet(catSheet, hdrs_withIdx):
    return find_range_by_columnItem(catSheet, hdrs_withIdx["Q'ty Cal Type Tag"], "-")

def get_DataOnRangesAtCatSheet(Sheet):
    
    hdrs_withIdx = find_headersAtCatSheet(Sheet)
    title_idx = map(lambda x: x[0], find_rangesAtCatSheet(Sheet, hdrs_withIdx).values())
    calcType_colDatas = list(map(lambda x: x[hdrs_withIdx["Q'ty Cal Type Tag"]], Sheet))
    calcTypes = list(map(lambda x: calcType_colDatas[x], title_idx))
    rgs_v = list(map(lambda x: x[1], find_rangesAtCatSheet(Sheet, hdrs_withIdx).values()))
    rgs_k = list(map(lambda x: x, find_rangesAtCatSheet(Sheet, hdrs_withIdx).keys()))
    
    hdrs_v = list(hdrs_withIdx.values())
    hdrs_k = list(hdrs_withIdx.keys())
    eff_hdrs_v = hdrs_v[2:]
    eff_hdrs_k = hdrs_k[2:]
    
    datas_allCalType = list(map(lambda x: Sheet[x[0]-1:x[1]], rgs_v))
    
    def setDict_OnEachCalType(data_calType):
        paramName_lang = "패밀리 매개변수(from Revit) 영문판" if lang_mode is True else "패밀리 매개변수(from Revit) 한글판"
        calcTypeName = data_calType[0][2]
        data_calType_noneless = list(filter(lambda x: x[hdrs_withIdx["항목"]] != None, data_calType))
#        ## WM row 별 header명 과 짝짓기
        data_withHdrsIdx = list(map(lambda y: list(map(lambda x: y[x], eff_hdrs_v)), data_calType_noneless))
        dict_ = list(map(lambda x: dict(zip(eff_hdrs_k, x)), data_withHdrsIdx))
        dicts_noneless = list(map(lambda y: dict(filter(lambda x: x[1]!=None, y.items())),dict_))
#        ## dict_Cal Type 입력처리
        targetColName = "Q'ty Cal Type Tag"
        dicts_finalNoneless = []
        for d in dicts_noneless:
            d["Q'ty Cal Type Tag"] = calcTypeName
            
            if "입력값" in d.keys():
                d["applyForCalc"] = d["입력값"]
                dicts_finalNoneless.append(d)
            elif paramName_lang in d.keys():
                d["applyForCalc"] = d[paramName_lang]
                dicts_finalNoneless.append(d)
            else:
                pass
        
        return {calcTypeName: dicts_finalNoneless}
        
    return map(setDict_OnEachCalType, datas_allCalType)
each_dict = get_DataOnRangesAtCatSheet(paramSheet)
dicts_AllInOne = {}
for d in each_dict:
    dict_k_v = d.items()
    for k,v in dict_k_v:
        dicts_AllInOne[k] = v
# Assign your output to the OUT variable.


OUT = dicts_AllInOne
# ----------------------------------------
물량param시트_약자_매개변수_정리 = Python(IN[0]=family_list_데이터_파싱_물량param_시트)  # CPython3
# ---------- 물량param시트_약자_매개변수_정리.python (32 lines) ----------
# Load the Python Standard and DesignScript Libraries
import sys
import clr
clr.AddReference('ProtoGeometry')
from Autodesk.DesignScript.Geometry import *

clr.AddReference("RevitNodes")
import Revit
from Revit.Elements import *

from functools import reduce
from functools import partial
from string import ascii_lowercase

# The inputs to this node will be stored as a list in the IN variables.
dataEnteringNode = IN
paramSheetDic = IN[0]
# Place your code below this line

def findDictPerCalType(dicList):
    dic = {}
    for i in dicList:
        dic[i["산출수식 약자"]] = i["applyForCalc"]
    
    return dic

ks_forDic = list(paramSheetDic.keys())
vs_forDic = list(map(findDictPerCalType, paramSheetDic.values()))

res = dict(zip(ks_forDic, vs_forDic))
# Assign your output to the OUT variable.
OUT = res
# ----------------------------------------
family_list_데이터_파싱_category_시트 = Python(IN[0]=deconstruct_3.rest, IN[1]=deconstruct_2.rest)  # CPython3
# ---------- family_list_데이터_파싱_category_시트.python (147 lines) ----------
# Load the Python Standard and DesignScript Libraries
import sys
import clr
clr.AddReference('ProtoGeometry')
from Autodesk.DesignScript.Geometry import *

from functools import reduce
from functools import partial
from string import ascii_lowercase

def getCharValue(s):
    # 베이스 케이스
    if not s:
        return 0
 
    value = 0
    # 입력 문자열을 대문자로 변환한 후 반복
    for ch in s:
        value = value * 26 + (ord(ch) - ord('A') + 1)
    return value
    
#################################Module For Functional Programing#############################################
curry = lambda f: lambda a,*args: f(a, *args) if (len(args)) else lambda *args: f(a, *args)

filter = curry(filter)
map = curry(map)

def _take(length, iter):
    res = []
    for a in iter:
        res.append(a)
        if len(res) == length:
            return res
        
take = curry(_take)
reduce = curry(reduce)

go = lambda *args: reduce(lambda a,f: f(a), args) ## 함수도 축약 가능 ##
##############################################################################################################
def find_IsInStr(target, str):
    if target == None or str == None:
        pass
    else:
        res = target in str
        return res

def find_range_by_columnItem(db, col_idx, sep_rule):
    tdb = list(map(lambda x: x[col_idx], db))
    last_idx_tdb = len(tdb)-1
    tdb_enum = enumerate(tdb)
    res = list(filter(lambda x: find_IsInStr(sep_rule, x[1]), tdb_enum))
    endidxs_tmp= list(map(lambda x: x[0]-1,res))
    #endidxs_tmp= list(map(lambda x: x[0],res))
    endidxs_tmp.pop(0)
    endidxs = endidxs_tmp + [last_idx_tdb]
    famTypeNames = list(map(lambda x: x[1],res))
    famTypeNamesIdxs = list(map(lambda x: x[0],res))
    rangeSttIdxs = list(map(lambda x: x[0]+1,res))
    rangeEndIdxs = endidxs
    result = dict(zip(famTypeNames, zip(famTypeNamesIdxs, zip(rangeSttIdxs,rangeEndIdxs))))
    return result

# The inputs to this node will be stored as a list in the IN variables.
dataEnteringNode = IN
db = IN[0]
allCatSheetsNames =IN[1]


paramSheet = db[0]
allCatSheets = db[1:]

# Place your code below this line

def find_headersAtCatSheet(catSheet):
    headers_CatSheet = map(lambda x: [x[1].replace("\n",""),x[0]], filter(lambda x: x[1] != None, enumerate(catSheet[1])))
    
    return dict(headers_CatSheet)

def find_rangesAtCatSheet(catSheet, hdrs_withIdx):
    return find_range_by_columnItem(catSheet, hdrs_withIdx["Family Type Name"], "H_")

def get_DataOnRangesAtCatSheet(catSheet): 
    hdrs_withIdx = find_headersAtCatSheet(catSheet)
    title_idx = map(lambda x: x[0], find_rangesAtCatSheet(catSheet, hdrs_withIdx).values())
    calcType_colDatas = list(map(lambda x: x[hdrs_withIdx["Q'ty Cal Type Tag"]], catSheet))
    calcTypes = list(map(lambda x: calcType_colDatas[x], title_idx))
    rgs_v = list(map(lambda x: x[1], find_rangesAtCatSheet(catSheet, hdrs_withIdx).values()))
    rgs_k = list(map(lambda x: x, find_rangesAtCatSheet(catSheet, hdrs_withIdx).keys()))
    
    hdrs_v = list(hdrs_withIdx.values())
    hdrs_k = list(hdrs_withIdx.keys())
    #tagDatas = list(zip(rgs_k,calcTypes))
    
    datas_allFamType = list(map(lambda x: list(zip(catSheet[x[0]-1:x[1]], range(x[0]-1,x[1]))), rgs_v))
    #datas_allFamType = list(zip(tagDatas, datas_allFamType_))
    
    def setDict_OnEachFamType(data_famType):  ## 최종적으로 산출식 없는 것 걸러내기 추가해야 함
        titleData = list(data_famType).pop(0)[0]
        
        famTypeName = titleData[hdrs_withIdx["Family Type Name"]]
        calcTypeName = titleData[hdrs_withIdx["Q'ty Cal Type Tag"]]
        data_famType_noneless = list(filter(lambda x: x[0][5] != None, data_famType))
        ## WM row 별 header명 과 짝짓기
        data_withHdrsIdx = list(map(lambda y: [list(map(lambda x: y[0][x], hdrs_v)), y[1]], data_famType_noneless))
        hdrs_k.append("rIDX")
        dict_ = list(map(lambda x: dict(zip(hdrs_k, x[0]+[x[1]])), data_withHdrsIdx))
        dicts_noneless = list(map(lambda y: dict(filter(lambda x: x[1]!=None, y.items())),dict_))
        ## dict_gauge, 물량산출식 없는 항목 처리
        dicts_final = []
        needDefault_ColName = "Gauge Code"
        noneRemove_ColName = "Dynamo 물량산출식"
        for d in dicts_noneless:
            d["Family Type Name"] = famTypeName
            
            if calcTypeName == None:
                pass            
            elif noneRemove_ColName in d.keys():
                d["Q'ty Cal Type Tag"] = calcTypeName
                d[needDefault_ColName] = ""
                dicts_final.append(d)

        
        return dicts_final
        
    dicts_allFamType = list(map(lambda x: setDict_OnEachFamType(list(x)), datas_allFamType))
    ds_famTypesAtCatSheet = dict(zip(rgs_k, dicts_allFamType))
    ds_famTypesAtCatSheet_effCalcType = dict(filter(lambda x: all(list(map(lambda i: "Q'ty Cal Type Tag" in i, x[1]))), list(ds_famTypesAtCatSheet.items())))
    ds_famTypesAtCatSheet_noneless = dict(filter(lambda x: len(list(x[1]))!=0, list(ds_famTypesAtCatSheet_effCalcType.items())))
    
    return  ds_famTypesAtCatSheet_noneless

## AllInOne 딕셔너리에 정리
dataOnRanges_allCat = list(map(get_DataOnRangesAtCatSheet, allCatSheets))
dataOnRanges_allCat_WithCatNames = list(zip(allCatSheetsNames, dataOnRanges_allCat))
dicts_AllInOne = {}

for d in dataOnRanges_allCat_WithCatNames:
    catName = d[0]
    dict_k_v = d[1].items()
    for k,v in dict_k_v:
        for wm in v:
            wm["SheetName"] = catName
        dicts_AllInOne[k] = v

# Assign your output to the OUT variable.
OUT = dicts_AllInOne
#OUT = get_DataOnRangesAtCatSheet(allCatSheets[0])#allCatSheetsWithNames#
# ----------------------------------------
family_list_데이터_파싱_category = Python(IN[0]=물량param시트_약자_매개변수_정리, IN[1]=family_list_데이터_파싱_category_시트)  # "Family List 데이터 파싱_Category - 물량Param 시트 결합"; CPython3
# ---------- family_list_데이터_파싱_category.python (46 lines) ----------
# Load the Python Standard and DesignScript Libraries
import sys
import clr
clr.AddReference('ProtoGeometry')
from Autodesk.DesignScript.Geometry import *

clr.AddReference("RevitNodes")
import Revit
from Revit.Elements import *

from functools import reduce
from functools import partial
from string import ascii_lowercase

# The inputs to this node will be stored as a list in the IN variables.
dataEnteringNode = IN
paramSheetDic = IN[0]
catSheetDic = IN[1]

# Place your code below this line
headers = list(catSheetDic.values())[0][0].Keys
wmspec_headers = list(filter(lambda x: "Work C" in x or "Spec" in x, headers))

def matchWith_paramDic(catSheetDic, paramSheetDic):
    res = {}
    for famType,diclist in catSheetDic.items():
        new_diclist = []
        for d in diclist:
            new_d = {}
            keys = d.Keys
            keys_new = set(keys) - set(wmspec_headers)
            calcType = d["Q'ty Cal Type Tag"]
            new_d["Sym_Val Dict"] = paramSheetDic[calcType]
            new_d["wmSpecs"] = list(map(lambda x: d[x],wmspec_headers))
            for spec in keys_new:
                new_d[spec] = d[spec]
            new_diclist.append(new_d)
        
        res[famType] = new_diclist
        
    return res
    

#res2 = map(lambda x: x[1], catSheetDic.items())
# Assign your output to the OUT variable.
OUT = matchWith_paramDic(catSheetDic, paramSheetDic)
# ----------------------------------------

# group: All Elements in Revit
all_elementsexceptrails = Python()  # CPython3; unwired: IN[0]
# ---------- all_elementsexceptrails.python (51 lines) ----------
# Load the Python Standard and DesignScript Libraries
import sys
import clr
clr.AddReference('ProtoGeometry')
from Autodesk.DesignScript.Geometry import *

clr.AddReference('RevitAPI')
from Autodesk.Revit.DB import *
import Autodesk

clr.AddReference('RevitServices')
import RevitServices
from RevitServices.Persistence import DocumentManager
doc = DocumentManager.Instance.CurrentDBDocument

def get_all_BIC():

    db = [
    Autodesk.Revit.DB.BuiltInCategory.OST_Floors,
    Autodesk.Revit.DB.BuiltInCategory.OST_Roofs,
    Autodesk.Revit.DB.BuiltInCategory.OST_Walls,
    Autodesk.Revit.DB.BuiltInCategory.OST_StructuralFoundation,
    Autodesk.Revit.DB.BuiltInCategory.OST_StructuralColumns,
    Autodesk.Revit.DB.BuiltInCategory.OST_StructuralFraming,
    Autodesk.Revit.DB.BuiltInCategory.OST_Ceilings,
    Autodesk.Revit.DB.BuiltInCategory.OST_Doors,
    Autodesk.Revit.DB.BuiltInCategory.OST_Windows,
    Autodesk.Revit.DB.BuiltInCategory.OST_Stairs,
    #Autodesk.Revit.DB.BuiltInCategory.OST_Railings,
    ]
    return db
    
def get_allElems(doc):
    bics = get_all_BIC()
    
    def getElems(x):
        collector = FilteredElementCollector(doc)
        res = collector.OfCategory(x).WhereElementIsNotElementType().ToElements()
        return res

    def getRailElems(x):
        collector = FilteredElementCollector(doc)
        res = collector.OfCategory(x).WhereElementIsNotElementType()
        return res

    res = map(getElems, bics)
#    res = getRailElems(Autodesk.Revit.DB.BuiltInCategory.OST_RailingSystemRail)
    return res


OUT = get_allElems(doc)
# ----------------------------------------
categories = Categories("OST_StairsRailing")
all_elements_of_category = ElementsOfCategory(Category=categories)
list_create = List.Create(item0=all_elements_of_category)
join = List.Join(list0=all_elementsexceptrails, list1=list_create)

# group: 필터링 구간 (패밀리 리스트에 없는 이름 제외)
flatten = List.Flatten(list=join)
code_block_5 = CodeBlock { "Type"; "Type Name"; }
getParameterValueByName = Element.GetParameterValueByName(element=flatten, parameterName=code_block_5.out0)
keys = DesignScript.Builtin.Dictionary.Keys(dictionary=family_list_데이터_파싱_category_시트)
getParameterValueByName_2 = Element.GetParameterValueByName(element=getParameterValueByName, parameterName=code_block_5.out1)
contains = List.Contains(list=keys, item=getParameterValueByName_2@L1)
filterByBoolMask = List.FilterByBoolMask(list=flatten, mask=contains)
code_block_6 = CodeBlock(filtered=filterByBoolMask.in) { filtered; }

# group: Family Type 별 WM 코드 Revit 되먹임
# note: Revit에 있는 Family Type 항목만
filterByBoolMask_2 = List.FilterByBoolMask(list=getParameterValueByName, mask=contains)
uniqueItems = List.UniqueItems(list=filterByBoolMask_2.in)
code_block_7 = CodeBlock(catSheetDatas=family_list_데이터_파싱_category, UniqElemTypes=uniqueItems) { catSheetDatas; UniqElemTypes; }
code_block_8 = CodeBlock { "Type"; "Type Name"; }
getParameterValueByName_3 = Element.GetParameterValueByName(element=code_block_7.UniqElemTypes, parameterName=code_block_8.out1)
valueAtKey = DesignScript.Builtin.Dictionary.ValueAtKey(dictionary=code_block_7.catSheetDatas, key=getParameterValueByName_3)
byKeysValues = DesignScript.Builtin.Dictionary.ByKeysValues(keys=getParameterValueByName_3, values=valueAtKey)
code_block_9 = CodeBlock { "Q'ty Cal Type Tag"; }
get_WMCodesAndBriefSpec = Python(IN[0]=byKeysValues, IN[1]=code_block_9)  # CPython3
# ---------- get_WMCodesAndBriefSpec.python (33 lines) ----------
# Load the Python Standard and DesignScript Libraries
import sys
import clr
clr.AddReference('ProtoGeometry')
from Autodesk.DesignScript.Geometry import *

# The inputs to this node will be stored as a list in the IN variables.
dataEnteringNode = IN
dict_aio = IN[0]
calType_header = IN[1]
# Place your code below this line
famTypes = list(dict_aio.items())
res_dict = {}


def find_WMspecsPerFamType(k_v):
    k = k_v[0]
    wms = k_v[1]
    res = list(map(lambda x: [x["Work Master Code"]] + x["wmSpecs"], wms))
    res_zeroless = list(map(lambda y: filter(lambda x: x!=0, y), res))
    joined_strs = list(map(lambda x: ' | '.join(x),res_zeroless))

    return k,joined_strs

WMspecs = list(map(find_WMspecsPerFamType, famTypes))

for k,v in WMspecs:
    res_dict[k] = [dict_aio[k][0][calType_header]] + v



# Assign your output to the OUT variable.
OUT = res_dict
# ----------------------------------------
valueAtKey_2 = DesignScript.Builtin.Dictionary.ValueAtKey(dictionary=get_WMCodesAndBriefSpec, key=getParameterValueByName_3)
code_block_10 = CodeBlock()
# ---------- code_block_10.designscript (12 lines) ----------
[
"H_Q'ty Cal Type Tag",
"H_WM Code_1",
"H_WM Code_2",
"H_WM Code_3",
"H_WM Code_4",
"H_WM Code_5",
"H_WM Code_6",
"H_WM Code_7",
"H_WM Code_8",
"H_WM Code_9"
];
# ----------------------------------------
setParamElementTypes = Python(IN[0]=code_block_7.UniqElemTypes, IN[1]=valueAtKey_2, IN[2]=code_block_10)  # CPython3; frozen
# ---------- setParamElementTypes.python (36 lines) ----------
# Load the Python Standard and DesignScript Libraries
import sys
import clr
clr.AddReference('ProtoGeometry')
from Autodesk.DesignScript.Geometry import *

clr.AddReference("RevitNodes")
import Revit
from Revit.Elements import *

# The inputs to this node will be stored as a list in the IN variables.
dataEnteringNode = IN
elemTypes = IN[0]
WMs_perFamTyp = IN[1]
param_ListForWM = IN[2]

input_sets = list(zip(elemTypes, WMs_perFamTyp))

# Place your code below this line

def setParamAnElem(elem, paramNames, paramVals):
    effName_List = paramNames[:len(paramVals)]
    effVals_List = paramVals
    setForParam = list(zip(effName_List, effVals_List))
    res = list(map(lambda x: elem.SetParameterByName(x[0],x[1]), setForParam))
    
    return res


final = map(lambda x: setParamAnElem(x[0],param_ListForWM,x[1]), input_sets)


#res = elemT.GetParameterValueByName("Default Thickness")
# Assign your output to the OUT variable.
#OUT = input_sets
OUT = final
# ----------------------------------------

code_block_11 = CodeBlock(i=family_list_데이터_파싱_category) { i["H_SF_ACE_Mass_T2500"]; }
code_block_12 = CodeBlock(file_path=family_list_경로_입력) { file_path; }

# group: 심볼 및 값 추출(토공 포함) / 수식계산 / 익스포트 용 데이터 정리
family_list데이터_revit_부재_데이터_결합 = Python(IN[0]=family_list_데이터_파싱_category, IN[1]=code_block_6)  # "family list데이터 - Revit 부재 데이터 결합 & Sym_Val Dict 값 업데이트(타입,인스턴스 매개변수)"; CPython3; frozen
# ---------- family_list데이터_revit_부재_데이터_결합.python (68 lines) ----------
# Load the Python Standard and DesignScript Libraries
import sys
import clr

clr.AddReference('RevitAPI')
from Autodesk.Revit.DB import *
import Autodesk

#clr.AddReference('RevitNodes')
#import Revit
#clr.ImportExtensions(Revit.Elements)

clr.AddReference('RevitServices')
import RevitServices
from RevitServices.Persistence import DocumentManager
#doc = DocumentManager.Instance.CurrentDBDocument
#collector1 = FilteredElementCollector(doc)

clr.AddReference('ProtoGeometry')
from Autodesk.DesignScript.Geometry import *

from itertools import chain
from functools import reduce

# The inputs to this node will be stored as a list in the IN variables.
dataEnteringNode = IN
famlist_dic = IN[0]
revitElems = IN[1]

# Place your code below this line
def matchWith_Elem_Dict(famlist_dic,revitElems):
    res = []
    for i in revitElems:
        tmp = {}
        famTypeName = i.GetParameterValueByName("Type").GetParameterValueByName("Type Name")
        tmp["Elem"] = i
        tmp["wms"] = famlist_dic[famTypeName]
        
        res.append(tmp)
    return res

def update_sym_valDict(elemDicts):
    for d in elemDicts:
        elem = d["Elem"]
        wms = d["wms"]
        
        for wm in wms:
            sym_valDict = wm["Sym_Val Dict"]
            sv_keys = sym_valDict.Keys
            sv_vals = sym_valDict.Values
            sv_items = list(zip(sv_keys, sv_vals))
            
            for x in sv_items:
                [k,v] = x
                if isinstance(v, str):
                    if v == "Level":
                        #sym_valDict[k] = type(UnwrapElement(elem.GetParameterValueByName(v)))
                        sym_valDict[k] = round(elem.GetParameterValueByName("Elevation at Bottom"),2)
                    elif elem.GetParameterValueByName(v):
                        sym_valDict[k] = elem.GetParameterValueByName(v)
                    elif elem.GetParameterValueByName("Type").GetParameterValueByName(v):
                        sym_valDict[k] = elem.GetParameterValueByName("Type").GetParameterValueByName(v)
                    else:
                        pass
    return elemDicts

# Assign your output to the OUT variable.
OUT = update_sym_valDict(matchWith_Elem_Dict(famlist_dic,revitElems))
# ----------------------------------------
# note: UG RC Union 준비(UG 부재 전체 형상 유니온 - PIT, Trench는 내부공동 포함하는 Boundary로)
# excavation 개별 형상 리스트
# 트레이에 하나 넣을 때마다,
# 처음은 그냥 두고,
# 두번째부터는 트레이에 있는 것과 겹치지 않는 부분만 남겨서 해당부분은 다음 코드로 반환 + 트레이 잔존
#     반환된 기초별 유효 터파기 형상을
#     UG RC Union이랑 디퍼런스 하면 백필형상
# 유표 터파기형상 볼륨 - 백필 형상 볼륨 = 디스포잘 값
토공_산출_구간 = Python(IN[0]=family_list데이터_revit_부재_데이터_결합)  # CPython3
# ---------- 토공_산출_구간.python (176 lines) ----------
# Load the Python Standard and DesignScript Libraries
import sys
import clr

clr.AddReference('RevitAPI')
from Autodesk.Revit.DB import *
import Autodesk

clr.AddReference('RevitNodes')
import Revit
clr.ImportExtensions(Revit.Elements)

clr.AddReference('RevitServices')
import RevitServices
from RevitServices.Persistence import DocumentManager
#doc = DocumentManager.Instance.CurrentDBDocument
#collector1 = FilteredElementCollector(doc)

clr.AddReference('ProtoGeometry')
from Autodesk.DesignScript.Geometry import *

from itertools import chain
from functools import reduce
import copy
###################################################################################################
curry = lambda f: lambda a,*args: f(a, *args) if (len(args)) else lambda *args: f(a, *args)

add = curry(lambda a,b: a + b)

filter = curry(filter)
map = curry(map)

def _take(length, iter):
    res = []
    for a in iter:
        res.append(a)
        if len(res) == length:
            return res
take = curry(_take)
reduce = curry(reduce)

go = lambda *args: reduce(lambda a,f: f(a), args) ## 함수도 축약 가능 ##
###########################################
# The inputs to this node will be stored as a list in the IN variables.
dataEnteringNode = IN
elemDicts = IN[0]
    

# Place your code below this line


def makeExcaShape(elem, sym_valDict):
    def findBtmCrv(geo, sym_valDict): ##btmOffset = d1 + d2
        offSetDist = sym_valDict["D1"] + sym_valDict["D2"]
        #H2 = sym_valDict["H2"] if sym_valDict["H2"]>=0 else -sym_valDict["H2"]
        h = abs(sym_valDict["C1"] + sym_valDict["C2"] + sym_valDict["C3"])
        bdBox_fdn = BoundingBox.ByGeometry(geo).ToCuboid() ## 형상의 자그마한 요철 무시
        srfs = bdBox_fdn.Explode() ## surface들
        btmSrf = PolySurface.ByJoinedSurfaces(list(filter(lambda x: round(x.NormalAtParameter(0.5,0.5).Z, 3) == -1, srfs)))
        btmCrvs = btmSrf.PerimeterCurves()
        btmPolCrv = PolyCurve.ByJoinedCurves(btmCrvs)
        offseted_btmPolCrv = btmPolCrv.Offset(offSetDist)
        h_modified_btmPolCrv = offseted_btmPolCrv.Translate(0,0,-h-0.3)
        return h_modified_btmPolCrv
    
    def findUprCrv(_btmPolCrv, sym_valDict):
        btmCrvZ = _btmPolCrv.StartPoint.Z
        test = (sym_valDict["C1"] + sym_valDict["C2"] + sym_valDict["C3"])
        #H = abs(sym_valDict["H2"]) + (sym_valDict["C1"] + sym_valDict["C2"] + sym_valDict["C3"])
        H = abs(round(btmCrvZ,2))
        G = sym_valDict["G"]
        offSetDist = (G * H)
        
        uprPolCrv = _btmPolCrv.Translate(0,0,H).Offset(offSetDist)
        uprCrvZ = uprPolCrv.StartPoint.Z
        return uprPolCrv#_btmPolCrv,btmCrvZ,uprPolCrv,uprCrvZ #btmCrvZ,uprCrvZ,test


    fdnsGeo = elem.Geometry()[0]
    btmPolCrv = findBtmCrv(fdnsGeo, sym_valDict)
    uprPolCrv = findUprCrv(btmPolCrv, sym_valDict)
    
    return Solid.ByLoft([btmPolCrv,uprPolCrv])

    
def addExcaInElemDicts(elemDicts):
    allExcas = []
    for idx,dic in enumerate(elemDicts):
        elem = dic["Elem"]
        wms = dic["wms"]
        excaBln = "Exca" in "".join(list(map(lambda x: x["Dynamo 물량산출식"], wms)))
        if excaBln:
            sym_valDict = wms[0]["Sym_Val Dict"]
            excaGeo = makeExcaShape(elem, sym_valDict)
            try:
                allExcasUni = Solid.ByUnion(allExcas)
                eff_excaGeo = excaGeo.Split(allExcasUni)[0]
                allExcas.append(excaGeo)
            except:
                eff_excaGeo = excaGeo
                allExcas.append(excaGeo)
            dic["ExcaGeo"] = eff_excaGeo

    return elemDicts


def find_allGeo_UG_elems(elemDicts):
    geoResult = []
    for dic in elemDicts:
        elem = dic["Elem"]
        wms = dic["wms"]
        excaBln = "Exca" in "".join(list(map(lambda x: x["Dynamo 물량산출식"], wms)))
        famType_ = wms[0]["Family Type Name"]
            
        if "MAT_" in famType_ or "Mass_" in famType_ or "Pit" in famType_ or "Trench" in famType_:
            if "Slab" in famType_ or "MAT_" in famType_ or "Mass_" in famType_ : ## 내부 빈공간 있는 RC부재는 꽉채워서 공제 
                srfs = elem.Geometry()[0].Explode() ## surface들
                btmSrf = PolySurface.ByJoinedSurfaces(list(filter(lambda x: round(x.NormalAtParameter(0.5,0.5).Z, 3) == -1, srfs)))
                btmCrvs = btmSrf.PerimeterCurves()
                btmPolCrv = PolyCurve.ByJoinedCurves(btmCrvs)
                btmCrvZ = btmPolCrv.StartPoint.Z
                uprPolCrv = btmPolCrv.Translate(0,0,(0-btmCrvZ))
                targetGeo = Solid.ByLoft([btmPolCrv,uprPolCrv])
                geoResult.append(targetGeo)
            else:
                geoResult.append(elem.Geometry()[0])
        elif "PED_" in famType_ or "TG_" in famType_ or "SOG_" in famType_ or "UG" in famType_:
            geoResult.append(elem.Geometry()[0])
            
        elif excaBln:
            geoResult.append(elem.Geometry()[0])
            

    return geoResult


def add_effExcaInElemDicts(elemDicts):
    
    allGeo_UG_RC_Elems = find_allGeo_UG_elems(elemDicts)
    allUniGeo_UG_RC_Elems = Solid.ByUnion(allGeo_UG_RC_Elems)
    elemDicts_excas = addExcaInElemDicts(elemDicts)
    
    for dic in elemDicts_excas:
        if "ExcaGeo" in dic.keys():
            excaGeo = dic["ExcaGeo"]

            eff_excaGeo = excaGeo
            splitResult = eff_excaGeo.Split(allUniGeo_UG_RC_Elems)
            dic["effExcaGeo"] = eff_excaGeo
            dic["effBackfillGeo"] = splitResult[0]
            #try:
            #    dic["effDisposalGeo"] = splitResult[1]#eff_excaGeo.Intersect(allUniGeo_UG_RC_Elems)
            #except:
            #    dic["effDisposalGeo"] = []
        
        wms = dic["wms"]
        for wm in wms:
            if "Exca" in wm["Dynamo 물량산출식"] or\
               "Back" in wm["Dynamo 물량산출식"] or\
               "Disp" in wm["Dynamo 물량산출식"]:
                wm["Sym_Val Dict"]["Exca"] = dic["effExcaGeo"].Volume
                wm["Sym_Val Dict"]["Back"] = dic["effBackfillGeo"].Volume
                wm["Sym_Val Dict"]["Disp"] = dic["effExcaGeo"].Volume - dic["effBackfillGeo"].Volume

                #try:
                #    wm["Sym_Val Dict"]["Disp"] = dic["effDisposalGeo"].Volume
                #except:
                #    wm["Sym_Val Dict"]["Disp"] = 0


    return elemDicts_excas


# Assign your output to the OUT variable.
OUT = add_effExcaInElemDicts(elemDicts)#elemDicts_ExcasWithWholeExcaList
#OUT = allUniGeo_UG_RC_Elems
# ----------------------------------------
# note: Sym Val Dict에서
# 산출식에 사용된 것 이외를
# 제거하기
부재_wm_별_산식에_의한_최종_계산 = Python(IN[0]=토공_산출_구간)  # CPython3; frozen
# ---------- 부재_wm_별_산식에_의한_최종_계산.python (91 lines) ----------
# Load the Python Standard and DesignScript Libraries
import sys
import clr

clr.AddReference('RevitAPI')
from Autodesk.Revit.DB import *
import Autodesk

clr.AddReference('RevitNodes')
import Revit
clr.ImportExtensions(Revit.Elements)

clr.AddReference('RevitServices')
import RevitServices
from RevitServices.Persistence import DocumentManager
#doc = DocumentManager.Instance.CurrentDBDocument
#collector1 = FilteredElementCollector(doc)

clr.AddReference('ProtoGeometry')
from Autodesk.DesignScript.Geometry import *

from itertools import chain
from functools import reduce
import copy
###################################################################################################
curry = lambda f: lambda a,*args: f(a, *args) if (len(args)) else lambda *args: f(a, *args)

add = curry(lambda a,b: a + b)

filter = curry(filter)
map = curry(map)

def _take(length, iter):
    res = []
    for a in iter:
        res.append(a)
        if len(res) == length:
            return res
take = curry(_take)
reduce = curry(reduce)

go = lambda *args: reduce(lambda a,f: f(a), args) ## 함수도 축약 가능 ##
###########################################
# The inputs to this node will be stored as a list in the IN variables.
dataEnteringNode = IN
elemDicts = IN[0]

def clean_SymValDict(elemDicts):
    for dic in elemDicts:
        wms = dic["wms"]
        for wm in wms:
            formula = wm["Dynamo 물량산출식"]
            SymValDicts = wm["Sym_Val Dict"]
            SymValItems = list(zip(SymValDicts.Keys, SymValDicts.Values))
            sym_val_keySets = []
            sym_val_valSets = []
            for k,v in SymValItems:
                if k in formula:
                    sym_val_keySets.append(k)
                    sym_val_valSets.append(v)
            #wm["Sym_Val Set"] = [sym_val_keySets,sym_val_valSets]
            wm["Sym_Val Set"] = dict(zip(sym_val_keySets,sym_val_valSets))
            formula_eqSymRemove = formula.lstrip("=")
            tmp = formula_eqSymRemove
            for k in sym_val_keySets: ## 이 부분은 좀더 범용 처리 필요할수도
                priorSymList = ["Exca", "Back", "Disp"]
                #any(list(map(lambda x: x in tmp, priorList)))
                #if "Exca" in tmp or "Back" in tmp or "Disp" in tmp:
                if any(list(map(lambda x: x in tmp, priorSymList))):
                    appliedSym = list(filter(lambda x: x in tmp, priorSymList))[0]
                    #if len(k) > 1:
                    if k == appliedSym:
                        tmp = tmp.replace(k, str(wm["Sym_Val Set"][k]))
                else:
                    tmp = tmp.replace(k, str(wm["Sym_Val Set"][k]))
                
            
            #wm["calcResult"] = tmp.strip()
            wm["calcResult"] = round(eval(tmp.strip()),3)
    
    return elemDicts

# Place your code below this line

elemDicts_withSymValSet = clean_SymValDict(elemDicts)




# Assign your output to the OUT variable.
OUT = clean_SymValDict(elemDicts)
# ----------------------------------------
wm별_총합_계산_및_엑셀_익스포트_준비 = Python(IN[0]=부재_wm_별_산식에_의한_최종_계산)  # CPython3
# ---------- wm별_총합_계산_및_엑셀_익스포트_준비.python (71 lines) ----------
# Load the Python Standard and DesignScript Libraries
import sys
import clr
clr.AddReference('ProtoGeometry')
from Autodesk.DesignScript.Geometry import *

import operator
from itertools import groupby
import copy

# The inputs to this node will be stored as a list in the IN variables.
dataEnteringNode = IN
elemDicts = IN[0]
# Place your code below this line
def extractCalcResult(elemDicts):
    res = []
    for d in elemDicts:
        wms = d["wms"]
        for wm in wms:
            keys = ["SheetName", "rIDX", "Work Master Code", "Family Type Name", "calcResult"]
            vals = list(map(lambda x: wm[x],keys))
            k_v = list(zip(keys, vals))
            res.append(dict(k_v))
        
    return res


def make_dict_groupBy_Sheet_WM(elemDicts):
    extractedDicts = extractCalcResult(elemDicts)
    sortedDicts_sheet = sorted(extractedDicts, key=operator.itemgetter("SheetName"))
    grpDicts_Sheet = groupby(sortedDicts_sheet, lambda x: x["SheetName"])
    
    res = {}
    for k, g in grpDicts_Sheet:
        sorted_g = sorted(list(g), key=operator.itemgetter("rIDX"))
        grped_g = groupby(sorted_g, lambda x: x["rIDX"])
        tmp = []
        for k_,g_ in grped_g:
            gg = copy.deepcopy(list(g_))
            calcSum = round(sum(map(lambda x: x["calcResult"],gg)),3)
            rIDX = gg[0]["rIDX"]
            tmp.append((rIDX,calcSum))
            
        res[k] = tmp
    return res

def fill_dict_emptySlot(dic):
    tmp = []
    for k, v in dic.items():
#        for d in v:
#            all_idxs = list(map(lambda x: x[0],v))
#            max_idx = max(all_idxs)
#            full_range = range(0, max_idx+1)
        all_idxs = list(map(lambda x: x[0],v))
        max_idx = max(all_idxs)
        full_range = range(0, max_idx+1)
        
        for i in full_range:
            if i not in all_idxs:
                v.append([i, ""])
        tmp.append(sorted(v, key=operator.itemgetter(0)))
        
    res = list(zip(dic.keys(),tmp))
    return dict(res)



dict_groupBy_Sheet_WM = make_dict_groupBy_Sheet_WM(elemDicts)

# Assign your output to the OUT variable.
OUT = [fill_dict_emptySlot(dict_groupBy_Sheet_WM), elemDicts]
# ----------------------------------------
code_block_13 = CodeBlock(i=wm별_총합_계산_및_엑셀_익스포트_준비) { i[0]; i[1]; }

# group: Family List엑셀파일 물량 기입 구간
code_block_14 = CodeBlock(file_path=code_block_12) { file_path; }
components = DesignScript.Builtin.Dictionary.Components(dictionary=code_block_13.out0)  # frozen
code_block_15 = CodeBlock { 6; 31; }
code_block_16 = CodeBlock { 1; }
getItemAtIndex = List.GetItemAtIndex(list=components.values@@L2, index=code_block_16)
dropItems = List.DropItems(list=getItemAtIndex@L2, amount=code_block_15.out0)
exportToExcel = Data.ExportToExcel(filePath=code_block_14, sheetName=components.keys@L1, startRow=code_block_15.out0, startColumn=code_block_15.out1, data=dropItems@L2)

code_block_17 = CodeBlock(wm_sheetDatas=deconstruct_3.first) { wm_sheetDatas; }
code_block_18 = CodeBlock(wm_sheetDatas=code_block_17) { wm_sheetDatas; }

# group: [WM-AR] 시트 데이터 정리
code_block_19 = CodeBlock(wm_sheetDatas=code_block_18) { wm_sheetDatas; }  # frozen
code_block_20 = CodeBlock { 3; }
getItemAtIndex_2 = List.GetItemAtIndex(list=code_block_19@L2, index=code_block_20)
code_block_21 = CodeBlock { 6; }
dropItems_2 = List.DropItems(list=getItemAtIndex_2, amount=code_block_21)
uniqueItems_2 = List.UniqueItems(list=dropItems_2)
code_block_22 = CodeBlock(description판별항목1=uniqueItems_2) { description판별항목1; }
code_block_23 = CodeBlock { 5; }
getItemAtIndex_3 = List.GetItemAtIndex(list=code_block_19@L2, index=code_block_23)
code_block_24 = CodeBlock { 6; }
dropItems_3 = List.DropItems(list=getItemAtIndex_3, amount=code_block_24)
uniqueItems_3 = List.UniqueItems(list=dropItems_3)
code_block_25 = CodeBlock(description판별항목2=uniqueItems_3) { description판별항목2; }

extract_fromWMsheet = Python(IN[0]=code_block_19)  # CPython3
# ---------- extract_fromWMsheet.python (70 lines) ----------
# Load the Python Standard and DesignScript Libraries
import sys
import clr
clr.AddReference('ProtoGeometry')
from Autodesk.DesignScript.Geometry import *

# The inputs to this node will be stored as a list in the IN variables.
dataEnteringNode = IN
wm_sheetDatas = IN[0]
# Place your code below this line
wm_sheetDatas_noneless = \
    list(filter(lambda row: not all(row),wm_sheetDatas))

def find_headers_wmSheet(wm_sheetDatas_noneless):

    headers_tmp = wm_sheetDatas_noneless[2]
    subHead_tmp = wm_sheetDatas_noneless[3]
    
    headers_L1 = []
    for i,v in enumerate(headers_tmp):
        if (v is not None): headers_L1.append(v)
        else: headers_L1.append(headers_L1[i-1])
    
    headers_L1_L2 = []
    for i,v in enumerate(subHead_tmp):
        if (v is not None): headers_L1_L2.append(headers_L1[i] + "_" + v)
        else: headers_L1_L2.append(headers_L1[i])
        
    return list(enumerate(headers_L1_L2))

headers = find_headers_wmSheet(wm_sheetDatas_noneless)

headers_nonLineBreak = list(map(lambda hd: [hd[1].replace("\n"," "), hd[0]],headers))

headers_dict = {}
for i in headers_nonLineBreak:
    if i[0] not in headers_dict:
        headers_dict[i[0]] = i[1]






def find_wmDicts(wm_sheetDatas_noneless):
    decr_colDatas = list(map(lambda x: x[headers_dict["Category(Large)_Description"]], wm_sheetDatas_noneless))
    firsIDX = decr_colDatas.index("AR-Dummy")

    wm_sheetDatas_noHeads = wm_sheetDatas_noneless[firsIDX:]
    wmDicts = []
    
    for row in wm_sheetDatas_noHeads:
        #ref = headers_dict.items()
        tmp = []
        for k,idx in headers_dict.items():
            if row[idx] is not None:
                tmp.append([k,row[idx]])
            else:
                tmp.append([k,""])
        res = dict(tmp)
        wmDicts.append(res)

    return wmDicts





# Assign your output to the OUT variable.
OUT = find_wmDicts(wm_sheetDatas_noneless)
# ----------------------------------------

# group: 토공 형상 검토
code_block_26 = CodeBlock { "effExcaGeo"; "effBackfillGeo"; }
custom_selection = CustomSelection("되메우기 형상", items={터파기 형상: "effExcaGeo", 되메우기 형상: "effBackfillGeo"})
토공_형상_검토 = Python(IN[0]=custom_selection, IN[1]=부재_wm_별_산식에_의한_최종_계산)  # CPython3
# ---------- 토공_형상_검토.python (18 lines) ----------
# Load the Python Standard and DesignScript Libraries
import sys
import clr
clr.AddReference('ProtoGeometry')
from Autodesk.DesignScript.Geometry import *

# The inputs to this node will be stored as a list in the IN variables.
dataEnteringNode = IN

tgt_key = IN[0]
elemDicts = IN[1]
# Place your code below this line

onlyExcaDicts = list(filter(lambda x: tgt_key in x.keys(), elemDicts))
res = list(map(lambda x: x[tgt_key], onlyExcaDicts))

# Assign your output to the OUT variable.
OUT = res
# ----------------------------------------
code_block_27 = CodeBlock { 6; }
code_block_28 = CodeBlock(i=토공_형상_검토, j=code_block_27) { i[j]; }
watch_3d = Watch3D(code_block_28)

pip_test = Python()  # CPython3; frozen; unwired: IN[0]
# ---------- pip_test.python (17 lines) ----------
# Load the Python Standard and DesignScript Libraries
import sys
import subprocess
import clr
clr.AddReference('ProtoGeometry')
from Autodesk.DesignScript.Geometry import *

# The inputs to this node will be stored as a list in the IN variables.
dataEnteringNode = IN

# Place your code below this line
def pip_install(package):
    subprocess.check_call(["pip", "install", package])

pip_install("numpy")
# Assign your output to the OUT variable.
OUT = 0
# ----------------------------------------

# group: Total BOQ엑셀 파일 물량기입 구간
total_boq_sheet_경로_입력 = Filename(".\Total BOQ.xlsx")  # graph input
code_block_29 = CodeBlock { "(AR) BOQ"; false; }
code_block_30 = CodeBlock(filePath=total_boq_sheet_경로_입력, sheetName=code_block_29.out0) { filePath; sheetName; }
total_boq복사_및_경로_반환 = Python(IN[0]=code_block_30.filePath)  # CPython3; frozen
# ---------- total_boq복사_및_경로_반환.python (26 lines) ----------
# Load the Python Standard and DesignScript Libraries
import sys
import clr
clr.AddReference('ProtoGeometry')
from Autodesk.DesignScript.Geometry import *
import datetime
import shutil

# The inputs to this node will be stored as a list in the IN variables.
dataEnteringNode = IN
origin_pathStr = IN[0]
# Place your code below this line
now = datetime.datetime.now()
strList = origin_pathStr.split('.')

add_str = now.strftime("%m%d-%I%M%S")
add_res = "".join(["_",add_str,"."])
strList.insert(1, add_res)
res = "".join(strList)

source = origin_pathStr
destination = res
shutil.copyfile(source, destination)

# Assign your output to the OUT variable.
OUT = res
# ----------------------------------------
건물명_입력 = StringInput("Steam Turbine Building")  # graph input
list_create_2 = List.Create(item0=code_block_22, item1=code_block_25)
file_from_path_2 = FileObject(path=total_boq_sheet_경로_입력)
# note: Work Master Code
# Gauge Code
# Description : (L03)
# Spec. : (L04~L11)
# Additional Spec : (Description 항목 값)
importExcel_2 = Data.ImportExcel(file=file_from_path_2, sheetName=code_block_29.out0, showExcel=code_block_29.out1)
total_boq_데이터_파싱__ar_boq시트 = Python(IN[0]=건물명_입력, IN[1]=list_create_2, IN[2]=importExcel_2)  # CPython3
# ---------- total_boq_데이터_파싱__ar_boq시트.python (160 lines) ----------
# Load the Python Standard and DesignScript Libraries
import sys
import clr
clr.AddReference('ProtoGeometry')
from Autodesk.DesignScript.Geometry import *

from functools import reduce
from functools import partial
from string import ascii_lowercase
import itertools
from itertools import chain

def getCharValue(s):
    # 베이스 케이스
    if not s:
        return 0
 
    value = 0
    # 입력 문자열을 대문자로 변환한 후 반복
    for ch in s:
        value = value * 26 + (ord(ch) - ord('A') + 1)
    return value
    
#################################Module For Functional Programing#############################################
curry = lambda f: lambda a,*args: f(a, *args) if (len(args)) else lambda *args: f(a, *args)

filter = curry(filter)
map = curry(map)

def _take(length, iter):
    res = []
    for a in iter:
        res.append(a)
        if len(res) == length:
            return res
        
take = curry(_take)
reduce = curry(reduce)

go = lambda *args: reduce(lambda a,f: f(a), args) ## 함수도 축약 가능 ##
##############################################################################################################
def find_IsInStr(target, str):
    if target == None or str == None:
        pass
    else:
        res = target in str
        return res
        
def find_IsInList(List, str):
    if str == None or List == None:
        pass
    else:
        res = str in List
        return res

def find_range_by_columnItem(db, col_idx, sep_rule):
    tdb = list(map(lambda x: x[col_idx], db))
    last_idx_tdb = len(tdb)-1
    tdb_enum = enumerate(tdb)
    res = list(filter(lambda x: find_IsInStr(sep_rule, x[1]), tdb_enum))
    endidxs_tmp= list(map(lambda x: x[0]-1,res))
    #endidxs_tmp= list(map(lambda x: x[0],res))
    endidxs_tmp.pop(0)
    endidxs = endidxs_tmp + [last_idx_tdb]
    famTypeNames = list(map(lambda x: x[1],res))
    famTypeNamesIdxs = list(map(lambda x: x[0],res))
    rangeSttIdxs = list(map(lambda x: x[0]+1,res))
    rangeEndIdxs = endidxs
    result = dict(zip(famTypeNames, zip(famTypeNamesIdxs, zip(rangeSttIdxs,rangeEndIdxs))))
    return result
    
def find_range_by_columnItem_discrim(db, col_idx, 판별항목):
    tdb = list(map(lambda x: x[col_idx], db))
    last_idx_tdb = len(tdb)-1
    tdb_enum = enumerate(tdb)
    res = list(filter(lambda x: find_IsInList(판별항목, x[1]), tdb_enum))
    endidxs_tmp= list(map(lambda x: x[0]-1,res))
    #endidxs_tmp= list(map(lambda x: x[0],res))
    endidxs_tmp.pop(0)
    endidxs = endidxs_tmp + [last_idx_tdb]
    famTypeNames = list(map(lambda x: x[1],res))
    famTypeNamesIdxs = list(map(lambda x: x[0],res))
    rangeSttIdxs = list(map(lambda x: x[0]+1,res))
    rangeEndIdxs = endidxs
    result = dict(zip(famTypeNames, zip(famTypeNamesIdxs, zip(rangeSttIdxs,rangeEndIdxs))))
    return result

# The inputs to this node will be stored as a list in the IN variables.
dataEnteringNode = IN
bd_name = IN[0]
descr판별항목 = IN[1]
판별항목lv1 = descr판별항목[0]
판별항목lv2 = descr판별항목[1]
db = IN[2]


# Place your code below this line

def find_headersAtSheet(Sheet):
    headers_Sheet = map(lambda x: [x[1].replace("\n",""),x[0]], filter(lambda x: x[1] != None, enumerate(Sheet[2])))
    res = dict(headers_Sheet)
    del res["_"]
    
    return res
    
def find_headers_Building(Sheet, bd_name):
    headers_bd = map(lambda x: [x[1].replace("\n",""),x[0]], filter(lambda x: x[1] != None, enumerate(Sheet[3])))
    headers_targetBD = list(filter(lambda x: x[0] == bd_name, headers_bd))
    res = {}
    res["targetBD"] = headers_targetBD[0][1]
    return res

def find_rangesAtSheet(Sheet, hdrs_withIdx, 판별항목):
    return find_range_by_columnItem_discrim(Sheet, hdrs_withIdx["Description"], 판별항목)

def get_DataOnRangesAtSheet(Sheet):
    
    hdrs_withIdx = dict(list(find_headersAtSheet(Sheet).items()) + list(find_headers_Building(Sheet, bd_name).items()))
    rgs_v_lv1 = list(map(lambda x: x[1], find_rangesAtSheet(Sheet, hdrs_withIdx, 판별항목lv1).values()))
    rgs_v_lv2 = list(map(lambda x: x[1], find_rangesAtSheet(Sheet, hdrs_withIdx, 판별항목lv2).values()))
    
    idxs_v_lv1 = list(map(lambda x: range(x[0],x[1]+1), rgs_v_lv1))

    datas_lv1 = []
    col_datas = list(map(lambda x: x[hdrs_withIdx["Description"]], Sheet))
    for rg in idxs_v_lv1:
        lv1_str = col_datas[rg[0]-1]
        tmp = []
        for i in rg:
            tmp.append([i, lv1_str, col_datas[i]])
        
        datas_lv1.append(tmp)

    datas_lv2 = []
    for rg in datas_lv1:
        tmp = []
        for idx,v in enumerate(rg):
            if v[2] == None:
                tmp.append([v[0],v[1],tmp[idx-1][2]])
            else:
                
                tmp.append(v)
        datas_lv2.append(tmp)

    flatten_res = list(chain(*datas_lv2))
    rres = itertools.groupby(flatten_res, lambda x: [x[1], x[2]])
    
    res = {}
    for k, g in rres:
        #print(list(g))
        removedfirstelem_g = list(g)[1:]
        res["_".join(k)] = [removedfirstelem_g[0][0],removedfirstelem_g[-1][0]]
        #res["_".join(k)] = removedfirstelem_g
    
    return res


hdrs_withIdx = dict(list(find_headersAtSheet(db).items()) + list(find_headers_Building(db, bd_name).items()))

OUT = hdrs_withIdx, get_DataOnRangesAtSheet(db)
# ----------------------------------------
code_block_31 = CodeBlock(i=total_boq_데이터_파싱__ar_boq시트) { i[0]; i[1]; }
code_block_32 = CodeBlock(dict_groupBy_Sheet_WM=code_block_13.out1) { dict_groupBy_Sheet_WM; }
wm별_계산결과_및_spec_정리 = Python(IN[0]=code_block_32)  # CPython3
# ---------- wm별_계산결과_및_spec_정리.python (69 lines) ----------
# Load the Python Standard and DesignScript Libraries
import sys
import clr
clr.AddReference('ProtoGeometry')
from Autodesk.DesignScript.Geometry import *

import operator
from itertools import groupby
import copy

# The inputs to this node will be stored as a list in the IN variables.
dataEnteringNode = IN
elemDicts = IN[0]
# Place your code below this line
def extractCalcResult(elemDicts):
    res = []
    for d in elemDicts:
        wms = d["wms"]
        for wm in wms:
            keys = ["SheetName", "rIDX", "Work Master Code", "Gauge Code", "wmSpecs", "Family Type Name", "calcResult"]
            vals = list(map(lambda x: wm[x],keys))
            k_v = list(zip(keys, vals))
            res_d = dict(k_v)
            if "Description" in wm.Keys:
                res_d["Description"] = wm["Description"]
            else:
                res_d["Description"] = ""
            res_d["wmcANDgauge"] = "".join([wm["Work Master Code"],wm["Gauge Code"]])
            res_d["UoM"] = wm["Unit"]
            res.append(res_d)
        
    return res

def make_dict_groupBy_WM(elemDicts):
    extractedDicts = extractCalcResult(elemDicts)
    sortedDicts_WMC = sorted(extractedDicts, key=operator.itemgetter("wmcANDgauge"))
    grpDicts_WMC = groupby(sortedDicts_WMC, key=operator.itemgetter("wmcANDgauge"))
    
    res = []
    for k, g in grpDicts_WMC: 
        wmCode = k
        gg = copy.deepcopy(list(g))
        calcSum = round(sum(map(lambda x: x["calcResult"], gg)),3)
        wmSpecs = gg[0]["wmSpecs"]
        catStr = "_".join([wmSpecs[0],wmSpecs[1]])
        specOnly = list(filter(lambda x: x!=0, wmSpecs))[3:]
        addSpec = gg[0]["Description"]
        dict_res = {
            "catStr": catStr,
            "Work Master Code": wmCode,
            "Gauge Code": gg[0]["Gauge Code"],
            "Description": wmSpecs[2],
            "Spec.": "\n".join(specOnly),
            "Additional Spec.": addSpec,
            "calcVal": calcSum,
            "UoM": gg[0]["UoM"]
            #"wmSpecs": wmSpecs,
            }
        res.append(dict_res)
    
    
    return res

extDicts = extractCalcResult(elemDicts)


# Assign your output to the OUT variable.
OUT = make_dict_groupBy_WM(elemDicts)
#OUT = sorted(set(map(lambda x: x["Work Master Code"], extDicts)))
# ----------------------------------------
data_formatting_for_excel_export = Python(IN[0]=code_block_31.out1, IN[1]=wm별_계산결과_및_spec_정리)  # CPython3
# ---------- data_formatting_for_excel_export.python (44 lines) ----------
# Load the Python Standard and DesignScript Libraries
import sys
import clr
clr.AddReference('ProtoGeometry')
from Autodesk.DesignScript.Geometry import *

from itertools import groupby
from itertools import chain

# The inputs to this node will be stored as a list in the IN variables.
dataEnteringNode = IN

rangeDicts = IN[0]
wmsList = IN[1]
# Place your code below this line

wmsSorted = sorted(wmsList, key=lambda x: x["Work Master Code"])
wmsGrped = groupby(wmsList, lambda x: x["catStr"])
wmsGrped_sorted = []

for k,v in wmsGrped:
    grp_sorted = sorted(list(v), key=lambda x: x["Work Master Code"])
    stt_idx = rangeDicts[k][0]
    length_grp = len(grp_sorted)
    idxs = range(stt_idx, stt_idx+length_grp)
    zip_grp_idxs = list(zip(idxs, grp_sorted))
    for i in zip_grp_idxs:
        d = i[1]
        d["rIDX"] = i[0]
    
    wmsGrped_sorted.append(grp_sorted)
    
wmsGrped_sorted_idxed = list(chain(*wmsGrped_sorted))

res = []
for n,v in enumerate(wmsGrped_sorted_idxed):
    if v["rIDX"] == wmsGrped_sorted_idxed[n-1]["rIDX"] + 1:
        res.append(v)
    else:
        pass


# Assign your output to the OUT variable.
OUT = wmsGrped_sorted_idxed
# ----------------------------------------
export_to_total_boq = Python(IN[0]=total_boq복사_및_경로_반환, IN[1]=code_block_30.sheetName, IN[2]=code_block_31.out0, IN[3]=data_formatting_for_excel_export)  # CPython3
# ---------- export_to_total_boq.python (57 lines) ----------
# Load the Python Standard and DesignScript Libraries
import sys
import clr
clr.AddReference('ProtoGeometry')
from Autodesk.DesignScript.Geometry import *

from itertools import groupby

import DSOffice

# The inputs to this node will be stored as a list in the IN variables.
dataEnteringNode = IN
filePath = IN[0]
sheetName = IN[1]
hdrs_withIdx = IN[2]
dictList = IN[3]

# Place your code below this line
exportToExcel = DSOffice.Data.ExportToExcel
#print(hdrs_withIdx)

hdrsColIdxs = [
        hdrs_withIdx["Work Master Code"],
        hdrs_withIdx["Gauge Code"],
        hdrs_withIdx["Description"],
        hdrs_withIdx["Spec."],
        hdrs_withIdx["Additional Spec.(설계자 작성)"],
        hdrs_withIdx["UoM"],
        hdrs_withIdx["targetBD"],
            ]


dictList_grped = groupby(dictList, lambda x: x["catStr"])

dictList_grpedList = []
for k,grp in dictList_grped:
    dictList_grpedList.append(list(grp))

def writeExcel(keys,startColhdr, grpedList):
    for i in dictList_grpedList:
        #keys = ["Work Master Code", "Gauge Code", "Description", "Spec.", "Additional Spec.", ]
        startCol = hdrs_withIdx[startColhdr]
        startRow = i[0]["rIDX"]

        datas = list(zip(*map(lambda y: map(lambda x: x[y], list(i)), keys)))
        #res.append(datas)
        exportToExcel(filePath, sheetName, startRow, startCol, datas)

keys1 = ["Work Master Code", "Gauge Code", "Description", "Spec.", "Additional Spec.", ]
keys2 = ["UoM"]
keys3 = ["calcVal"]

writeExcel(keys1,"Work Master Code", dictList_grpedList)
writeExcel(keys2,"UoM", dictList_grpedList)
writeExcel(keys3,"targetBD", dictList_grpedList)
# Assign your output to the OUT variable.
OUT = dictList_grpedList
# ----------------------------------------
code_block_33 = CodeBlock()
# ---------- code_block_33.designscript (2 lines) ----------
//WM code 채워진 상황에서 일치하는  칸에 값 기입하는 로직 추가 필요
//현재는 비워진 시트 기준으로 자동 채움 기능 구현
# ----------------------------------------

watch = Watch(total_boq_데이터_파싱__ar_boq시트)

# group: Excel data dictionarization
deconstruct_4 = List.Deconstruct(list=importExcel)
lang_mode_영_한_select_2 = BoolSelector(true)
family_list_데이터_파싱_물량param_시트_2 = Python(IN[0]=deconstruct_4.rest, IN[1]=deconstruct_2.first, IN[2]=lang_mode_영_한_select_2)  # CPython3; same code as family_list_데이터_파싱_물량param_시트
물량param시트_약자_매개변수_정리_2 = Python(IN[0]=family_list_데이터_파싱_물량param_시트_2)  # CPython3; same code as 물량param시트_약자_매개변수_정리
family_list_데이터_파싱_category_시트_2 = Python(IN[0]=deconstruct_4.rest, IN[1]=deconstruct_2.rest)  # CPython3; same code as family_list_데이터_파싱_category_시트
family_list_데이터_파싱_category_2 = Python(IN[0]=물량param시트_약자_매개변수_정리_2, IN[1]=family_list_데이터_파싱_category_시트_2)  # "Family List 데이터 파싱_Category - 물량Param 시트 결합"; CPython3; same code as family_list_데이터_파싱_category

excel_data_dictionarization = Python(IN[0]=lang_mode_영_한_select_2, IN[1]=importExcel, IN[2]=code_block_4)  # CPython3
# ---------- excel_data_dictionarization.python (99 lines) ----------
# Load the Python Standard and DesignScript Libraries
import sys
import clr
clr.AddReference('ProtoGeometry')
from Autodesk.DesignScript.Geometry import *

from functools import reduce
from functools import partial

# The inputs to this node will be stored as a list in the IN variables.
dataEnteringNode = IN
lang_mode = IN[0]
wholeDatas = IN[1]
db = wholeDatas[1:]
allCatSheetsNames = IN[2][1]

paramSheet = db[0]
allCatSheets = db[1:]

#db
# Place your code below this line
def find_IsInStr(target, str):
    if target == None or str == None:
        pass
    else:
        res = target in str
        return res
def find_range_by_columnItem(db, col_idx, sep_rule):
    tdb = list(map(lambda x: x[col_idx], db))
    last_idx_tdb = len(tdb)-1
    tdb_enum = enumerate(tdb)
    res = list(filter(lambda x: find_IsInStr(sep_rule, x[1]), tdb_enum))
    endidxs_tmp= list(map(lambda x: x[0]-1,res))
    endidxs_tmp.pop(0)
    endidxs = endidxs_tmp + [last_idx_tdb]
    famTypeNames = list(map(lambda x: x[1],res))
    famTypeNamesIdxs = list(map(lambda x: x[0],res))
    rangeSttIdxs = list(map(lambda x: x[0]+1,res))
    rangeEndIdxs = endidxs
    result = dict(zip(famTypeNames, zip(famTypeNamesIdxs, zip(rangeSttIdxs,rangeEndIdxs))))
    return result
    
    
def find_headersAtSheet(sheet):
    headers_sheet = map(lambda x: [x[1].replace("\n",""),x[0]], filter(lambda x: x[1] != None, enumerate(sheet[1])))
    
    return dict(headers_sheet)

def find_rangesAtSheet(sheet, hdrs_withIdx, trgt_hdr, trgt_str):
    return find_range_by_columnItem(sheet, hdrs_withIdx[trgt_hdr], trgt_str)


def get_DataOnRangesAtParamSheet(sheet):
    
    hdrs_withIdx = find_headersAtSheet(sheet)
    rangesATSheet = find_rangesAtSheet(sheet, hdrs_withIdx, "Q'ty Cal Type Tag", "-")
    title_idx = map(lambda x: x[0], rangesATSheet.values())
    calcType_colDatas = list(map(lambda x: x[hdrs_withIdx["Q'ty Cal Type Tag"]], sheet))
    calcTypes = list(map(lambda x: calcType_colDatas[x], title_idx))
    rgs_v = list(map(lambda x: x[1], rangesATSheet.values()))
    rgs_k = list(map(lambda x: x, rangesATSheet.keys()))
    
    hdrs_v = list(hdrs_withIdx.values())
    hdrs_k = list(hdrs_withIdx.keys())
    eff_hdrs_v = hdrs_v[2:]
    eff_hdrs_k = hdrs_k[2:]
    
    datas_allCalType = list(map(lambda x: sheet[x[0]-1:x[1]], rgs_v))
    
    def setDict_OnEachCalType(data_calType):
        paramName_lang = "패밀리 매개변수(from Revit) 영문판" if lang_mode is True else "패밀리 매개변수(from Revit) 한글판"
        calcTypeName = data_calType[0][2]
        data_calType_noneless = list(filter(lambda x: x[hdrs_withIdx["항목"]] != None, data_calType))
#        ## WM row 별 header명 과 짝짓기
        data_withHdrsIdx = list(map(lambda y: list(map(lambda x: y[x], eff_hdrs_v)), data_calType_noneless))
        dict_ = list(map(lambda x: dict(zip(eff_hdrs_k, x)), data_withHdrsIdx))
        dicts_noneless = list(map(lambda y: dict(filter(lambda x: x[1]!=None, y.items())),dict_))
#        ## dict_Cal Type 입력처리
        targetColName = "Q'ty Cal Type Tag"
        dicts_finalNoneless = []
        for d in dicts_noneless:
            d["Q'ty Cal Type Tag"] = calcTypeName
            
            if "입력값" in d.keys():
                d["applyForCalc"] = d["입력값"]
                dicts_finalNoneless.append(d)
            elif paramName_lang in d.keys():
                d["applyForCalc"] = d[paramName_lang]
                dicts_finalNoneless.append(d)
            else:
                pass
        
        return {calcTypeName: dicts_finalNoneless}
        
    return map(setDict_OnEachCalType, datas_allCalType)
    
    
# Assign your output to the OUT variable.
OUT = get_DataOnRangesAtParamSheet(paramSheet)
# ----------------------------------------
