# Dynamo graph Element-Function Matching Test(0711).dyn (Dynamo 2.10.1.3976)

code_block = CodeBlock()
# ---------- code_block.designscript (6 lines) ----------
[
2,
3,
5,
7
];
# ----------------------------------------
code_block_2 = CodeBlock { 2; 3; 5; 7; }
mul = _ * code_block_2.out0  # unwired: x
mul_2 = _ * code_block_2.out1  # unwired: x
mul_3 = _ * code_block_2.out2  # unwired: x
mul_4 = _ * code_block_2.out3  # unwired: x
join = List.Join(list0=mul, list1=mul_2, list2=mul_3, list3=mul_4)
code_block_3 = CodeBlock(NumList=code_block, FuncList=join)
# ---------- code_block_3.designscript (15 lines) ----------
NumList;
FuncList;

Output = [Imperative]
{
	numList = NumList;
	funcList = FuncList;
	listOut=[];
	for (i in 0..2)
	{
		//listTemp = [];
		listOut = List.AddItemToEnd([funcList[i],numList[i]],listOut);
	}
	return listOut;
};
# ----------------------------------------
firstItem = List.FirstItem(list=code_block_3.out2@L2)

# group: Function List part
code_block_4 = CodeBlock { 2; 3; 5; 7; }
mul_5 = _ * code_block_4.out0  # unwired: x
mul_6 = _ * code_block_4.out1  # unwired: x
mul_7 = _ * code_block_4.out2  # unwired: x
mul_8 = _ * code_block_4.out3  # unwired: x
join_2 = List.Join(list0=mul_5, list1=mul_6, list2=mul_7, list3=mul_8)

# group: Element List part
code_block_5 = CodeBlock()  # same code as code_block

# group: Primary Solution!!!
map = List.Map()  # unwired: list, function
laceShortest = List.LaceShortest(combineFunction=map, list0=join_2, list1=code_block_5)

# group: 함수1 생성 구간
code_block_6 = CodeBlock { "Volume"; }
getParameterValueByName = Element.GetParameterValueByName(parameterName=code_block_6)  # unwired: element

categories = Categories("OST_Walls")
all_elements_of_category = ElementsOfCategory(Category=categories)

# group: 필요한 개수로 함수 리스트 증식
count = List.Count(list=all_elements_of_category)
ofRepeatedItem = List.OfRepeatedItem(item=getParameterValueByName, amount=count)

# group: 엘리먼트와 함수 1대1 매칭 적용
map_2 = List.Map()  # unwired: list, function
laceShortest_2 = List.LaceShortest(combineFunction=map_2, list0=ofRepeatedItem, list1=all_elements_of_category)

# group: 함수2 생성 구간
code_block_7 = CodeBlock { "Area"; }
getParameterValueByName_2 = Element.GetParameterValueByName(parameterName=code_block_7)  # unwired: element

# group: 필요한 개수로 함수 리스트 증식
count_2 = List.Count(list=all_elements_of_category)
ofRepeatedItem_2 = List.OfRepeatedItem(item=getParameterValueByName_2, amount=count_2)

# group: 함수1 기능 확인 구간
code_block_8 = CodeBlock { "Volume"; }
getParameterValueByName_3 = Element.GetParameterValueByName(element=all_elements_of_category, parameterName=code_block_8)

# group: 함수2 기능 확인 구간
code_block_9 = CodeBlock { "Area"; }
getParameterValueByName_4 = Element.GetParameterValueByName(element=all_elements_of_category, parameterName=code_block_9)
