# Dynamo graph Element-Function Matching Test(0712).dyn (Dynamo 2.10.1.3976)

code_block = CodeBlock()
# ---------- code_block.designscript (6 lines) ----------
[
2,
3,
5,
7
];
# ----------------------------------------
code_block_2 = CodeBlock { 2; 3; 5; 7; }
mul = _ * code_block_2.out0  # unwired: x
mul_2 = _ * code_block_2.out1  # unwired: x
mul_3 = _ * code_block_2.out2  # unwired: x
mul_4 = _ * code_block_2.out3  # unwired: x
join = List.Join(list0=mul, list1=mul_2, list2=mul_3, list3=mul_4)
code_block_3 = CodeBlock(NumList=code_block, FuncList=join)
# ---------- code_block_3.designscript (15 lines) ----------
NumList;
FuncList;

Output = [Imperative]
{
	numList = NumList;
	funcList = FuncList;
	listOut=[];
	for (i in 0..2)
	{
		//listTemp = [];
		listOut = List.AddItemToEnd([funcList[i],numList[i]],listOut);
	}
	return listOut;
};
# ----------------------------------------
firstItem = List.FirstItem(list=code_block_3.out2@L2)

# group: Function List part
code_block_4 = CodeBlock { 2; 3; 5; 7; }
mul_5 = _ * code_block_4.out0  # unwired: x
mul_6 = _ * code_block_4.out1  # unwired: x
mul_7 = _ * code_block_4.out2  # unwired: x
mul_8 = _ * code_block_4.out3  # unwired: x
join_2 = List.Join(list0=mul_5, list1=mul_6, list2=mul_7, list3=mul_8)

# group: Element List part
code_block_5 = CodeBlock()  # same code as code_block

# group: Primary Solution!!!
map = List.Map()  # unwired: list, function
laceShortest = List.LaceShortest(combineFunction=map, list0=join_2, list1=code_block_5)

categories = Categories("OST_Walls")
all_elements_of_category = ElementsOfCategory(Category=categories)

# group: material index
getMaterials = Element.GetMaterials(element=all_elements_of_category)
flatten = List.Flatten(list=getMaterials)
name = Element.Name(element=flatten)

# group: 필요한 개수로 함수 리스트 증식
ofRepeatedItem = List.OfRepeatedItem()  # unwired: item, amount
count = List.Count(list=getMaterials@L2)
laceShortest_2 = List.LaceShortest(combineFunction=ofRepeatedItem, list0=all_elements_of_category, list1=count)
watch = Watch(laceShortest_2)

# group: All Elements of Category
watch_2 = Watch(watch)
flatten_2 = List.Flatten(list=watch_2)

# group: target WM 적용 함수 - element 매칭 구간
map_2 = List.Map()  # unwired: list, function
code_block_6 = CodeBlock { "Volume"; }
# note: 함수1 생성 구간
getParameterValueByName = Element.GetParameterValueByName(parameterName=code_block_6)  # unwired: element
code_block_7 = CodeBlock()
# ---------- code_block_7.designscript (5 lines) ----------
[
"A03AD032"
//,
//"A04AL077"
];
# ----------------------------------------
# note: 함수1 target materials index 검색
contains = String.Contains(str=name@L1, searchFor=code_block_7)
anyTrue = List.AnyTrue(list=contains@L2)
code_block_8 = CodeBlock { true; }
# note: getting index of element which has target materials
allIndicesOf = List.AllIndicesOf(list=anyTrue@L2, item=code_block_8)
flatten_3 = List.Flatten(list=allIndicesOf)
count_2 = List.Count(list=flatten_3)
# note: 필요한 개수로 함수 리스트 증식
ofRepeatedItem_2 = List.OfRepeatedItem(item=getParameterValueByName, amount=count_2)
watch_3 = Watch(ofRepeatedItem_2)
# note: wm 별 타겟 element 추출
getItemAtIndex = List.GetItemAtIndex(list=flatten_2, index=flatten_3)
# note: 엘리먼트와 함수 1대1 매칭 적용
laceShortest_3 = List.LaceShortest(combineFunction=map_2, list0=watch_3, list1=getItemAtIndex)

# group: 함수1 기능 확인 구간
code_block_9 = CodeBlock { "Volume"; }
getParameterValueByName_2 = Element.GetParameterValueByName(element=all_elements_of_category, parameterName=code_block_9)

# group: 함수2 기능 확인 구간
code_block_10 = CodeBlock { "Area"; }
getParameterValueByName_3 = Element.GetParameterValueByName(element=all_elements_of_category, parameterName=code_block_10)

# group: 함수2 생성 구간
code_block_11 = CodeBlock { "Area"; }
getParameterValueByName_4 = Element.GetParameterValueByName(parameterName=code_block_11)  # unwired: element

# group: 필요한 개수로 함수 리스트 증식
count_3 = List.Count(list=all_elements_of_category)
ofRepeatedItem_3 = List.OfRepeatedItem(item=getParameterValueByName_4, amount=count_3)
watch_4 = Watch(ofRepeatedItem_3)
