# Dynamo graph 03_Str Columns_r0(220127).dyn (Dynamo 2.12.0.5650)

# note: 되메우기기

# group: Primary Input : Excel & Revit Elements
categories = Categories("OST_StructuralColumns")
all_elements_of_category = ElementsOfCategory(Category=categories)
string_from_web = Python()  # CPython3; unwired: IN[0]
# ---------- string_from_web.python (19 lines) ----------
# Load the Python Standard and DesignScript Libraries
import sys
import clr
clr.AddReference('ProtoGeometry')
from Autodesk.DesignScript.Geometry import *
import urllib.request

# The inputs to this node will be stored as a list in the IN variables.
dataEnteringNode = IN
inputURL = "https://raw.githubusercontent.com/HNANmal/mQ/master/Hdynlib/General/ImportExcel.py"

# Place your code below this line
req = urllib.request
data = req.urlopen(inputURL)

result = data.read().decode("utf-8")

# Assign your output to the OUT variable.
OUT = result
# ----------------------------------------
file_path = Filename(".\DMS(Data Matching Schedule)_R0(Seq2)_STB_220121.xlsx")  # graph input
sheet_name = CodeBlock { "Str Columns"; }
github_python_import_excel_by = PythonStringNode(script=string_from_web, IN[0]=file_path, IN[1]=sheet_name)  # "Github_Python@Import Excel(By OpenpyXl)"; CPython3
code_block = CodeBlock(InputElement=all_elements_of_category, InputData=github_python_import_excel_by) { _InputElement; _InputData; }

# group: GetFull WMCodeDescription PerElement
excelDataManagerNode = Python(IN[0]=code_block._InputElement, IN[1]=code_block._InputData)  # CPython3
# ---------- excelDataManagerNode.python (279 lines) ----------
# Load the Python Standard and DesignScript Libraries
import os
import sys
sys.path.append(os.getenv('LOCALAPPDATA').replace('\\','\\\\') + r'\Programs\Python\Python39\Lib\site-packages')
import clr
clr.AddReference('RevitAPI')
import Autodesk

clr.AddReference('ProtoGeometry')
from Autodesk.DesignScript.Geometry import *

clr.AddReference('RevitNodes')
import Revit
clr.ImportExtensions(Revit.Elements)

clr.ImportExtensions(Revit.GeometryConversion)
clr.ImportExtensions(Revit.GeometryReferences)

clr.AddReference('RevitServices')
import RevitServices
from RevitServices.Persistence import DocumentManager
from RevitServices.Transactions import TransactionManager

doc = DocumentManager.Instance.CurrentDBDocument

import random
import itertools
from functools import reduce
from collections import Iterable
import datetime
import openpyxl

def iterable(obj):
    return isinstance(obj, Iterable)

def findUnique(inputs):
    result = []
    for i in inputs:
        if i in result:
            pass
        else:
            result.append(i)
    return result

# The inputs to this node will be stored as a list in the IN variables.
dataEnteringNode = IN
inputElements = IN[0]
inputData = IN[1]
#inputSheetName = IN[2]

def importExcel(path, SheetNameIn):
    wb_obj = openpyxl.load_workbook(str(path), data_only=True)
    sheet_obj = wb_obj.get_sheet_by_name(str(SheetNameIn))

    m_row = sheet_obj.max_row
    m_col = sheet_obj.max_column

    listOut = []

    for i in range(1, m_row +1):
        listTemp = []
        for j in range(1, m_col + 1):
            cell_obj = sheet_obj.cell(row=i, column=j)
            listTemp.append(cell_obj.value)
            if len(listTemp) == m_col:
                listOut.append(listTemp)
    return listOut

def getUsedFamilyTypeOfModeling(elements):
    familyCode = list(map(lambda x: x.Name.split('_')[0], elements))
    unq_familyCode = findUnique(familyCode)
    return unq_familyCode
    
def createExcelDataDictionary(values):
    result = {}
    for i in range(len(values)):
        result[str(i)] = values[i]
    return result

def findTargetIndex(targets, list):
    result = []
    for target in targets:
        for i in range(len(list)):
            if target in str(list[i]):
                result.append(i)
            else:
                pass
    result.sort()
    return result
    
def GetValueAtKeys(keys, dictionary):
    result = [] 
    for i in keys:
        result.append(dictionary[str(i)])
    return result


# Place your code below this line
usedFamilyTypeOfModeling = getUsedFamilyTypeOfModeling(inputElements)
excelWholeDataSet = inputData#importExcel(inputFilePath, inputSheetName)
trExcelWholeDataSet = list(zip(*excelWholeDataSet))
excelColumnDataSet = createExcelDataDictionary(trExcelWholeDataSet)
excelRowDataSet = createExcelDataDictionary(excelWholeDataSet)
ColumnIndexOfUsedFamilyType = findTargetIndex(usedFamilyTypeOfModeling, trExcelWholeDataSet)
ColDataSetOfUsedFamilyType = GetValueAtKeys(ColumnIndexOfUsedFamilyType, excelColumnDataSet)
materialPerElementFromModeling = []
for i in inputElements:
    materialPerElementFromModeling.append(i.GetMaterials())
#list(map(lambda x: x.GetMaterials, inputElements)) "맵함수로 처리하면 리스트화 할 때 타입 변환 오류 남"

targetWMRowIndex = []
for i in ColDataSetOfUsedFamilyType:
    targetWMRowIndex.append(findTargetIndex(['000'], i))

rowDataSetOfUsedWM = []
for i in targetWMRowIndex:
    rowDataSetOfUsedWM.append(GetValueAtKeys(i, excelRowDataSet))

workGroup = []
for i in rowDataSetOfUsedWM:
    tmp = []
    for j in i:
        tmp.append(j[0])
    workGroup.append(tmp)
    
workMaster = []
for i in range(len(ColDataSetOfUsedFamilyType)):
    tmp=[]
    for k in targetWMRowIndex[i]:
        tmp.append(ColDataSetOfUsedFamilyType[i][k])
    workMaster.append(tmp)

matchedWM = []
for i in range(len(workGroup)):
    tmp = []
    for j in range(len(workGroup[i])):
        fullWM = workGroup[i][j] +"-"+ workMaster[i][j]
        tmp.append(fullWM)
    matchedWM.append(tmp)

matchedWorkGruopAndMasterCode = []
for i in matchedWM:
    if len(i) > 0:
        matchedWorkGruopAndMasterCode.append(i)
    else:
        pass

matchedWMDescription = []
for i in rowDataSetOfUsedWM:
    tmp=[]
    for j in i:
        tmp.append(j[1] +" "+ j[2] +" "+ j[3] +" "+ "("+ j[4] +")")
    if len(tmp) > 0:
        matchedWMDescription.append(tmp)
    else:
        pass

matchedWMUnit = []
for i in rowDataSetOfUsedWM:
    tmp=[]
    for j in i:
        tmp.append(j[4])
    if len(tmp) > 0:
        matchedWMUnit.append(tmp)
    else:
        pass

matchedWorkGruopAndMasterCode_flat = list(itertools.chain(*matchedWorkGruopAndMasterCode))
matchedWMDescription_flat = list(itertools.chain(*matchedWMDescription))

dic_WMandDescription_Excel = {}
for i in range(len(matchedWorkGruopAndMasterCode_flat)):
    dic_WMandDescription_Excel[matchedWorkGruopAndMasterCode_flat[i]] = matchedWMDescription_flat[i]

usedFamilyTypeInExcelOrder = list(map(lambda x: x[3], ColDataSetOfUsedFamilyType))
usedFamilyCodeInExcelOrder = findUnique(list(map(lambda x: x.split('_')[0], usedFamilyTypeInExcelOrder)))

dic_FamilyCodeandWM = {}
for i in range(len(usedFamilyCodeInExcelOrder)):
    dic_FamilyCodeandWM[usedFamilyCodeInExcelOrder[i]] = matchedWorkGruopAndMasterCode[i]

workMasterCodePerElement = []
familyCodePerElem = list(map(lambda x: x.Name.split('_')[0], inputElements))
for i in familyCodePerElem:
    workMasterCodePerElement.append(dic_FamilyCodeandWM[i])

materialNamePerElem = []
for i in materialPerElementFromModeling:
    tmp = []
    for j in i:
        tmp.append(j.Name)
    materialNamePerElem.append(tmp)

WMPerElementFromModeling = []
for i in materialNamePerElem:
    tmp = []
    for j in i:
        tmp.append(j.split('_')[0])
    WMPerElementFromModeling.append(tmp)

specPerElementFromModeling = []
for i in materialNamePerElem:
    tmp = []
    for j in i:
        a = j.split('_')
        del a[0]
        b = " ".join(a)
        tmp.append(b)
    specPerElementFromModeling.append(tmp)

WMPerElementFromModeling_flat = list(itertools.chain(*WMPerElementFromModeling))
specPerElementFromModeling_flat = list(itertools.chain(*specPerElementFromModeling))

dic_WMandDescription_Model = {}
for i in range(len(WMPerElementFromModeling_flat)):
    dic_WMandDescription_Model[WMPerElementFromModeling_flat[i]] = specPerElementFromModeling_flat[i]

def findAllKeys(dict):
    result = []
    for key in dict.keys():
        result.append(key)
    return result

def findAllValues(dict):
    result = []
    for key in dict.keys():
        result.append(dict[key])
    return result

keys_WMandDescription_Model = findAllKeys(dic_WMandDescription_Model)
keys_WMandDescription_Excel = findAllKeys(dic_WMandDescription_Excel)

keys_WMandDescription_Both = list(set(keys_WMandDescription_Model + keys_WMandDescription_Excel))
values_WMandDescription_Both = []
for i in keys_WMandDescription_Both:
    if i in keys_WMandDescription_Model:
        values_WMandDescription_Both.append(dic_WMandDescription_Model[i])
    else:
        values_WMandDescription_Both.append(dic_WMandDescription_Excel[i])

dic_WMandDescription_Both = {}
for i in range(len(keys_WMandDescription_Both)):
    dic_WMandDescription_Both[keys_WMandDescription_Both[i]] = values_WMandDescription_Both[i]

workMasterCodePerElementFromBoth = []
for i in range(len(workMasterCodePerElement)):
    #tmp = []
    a = WMPerElementFromModeling[i] + workMasterCodePerElement[i]
    b = findUnique(a)
    workMasterCodePerElementFromBoth.append(b)

specPerElement = []
for i in workMasterCodePerElementFromBoth:
    tmp = []
    for j in i:
        tmp.append(dic_WMandDescription_Both[j])
    specPerElement.append(tmp)

fullWMCodeDescriptionPerElement = []
for i in range(len(workMasterCodePerElementFromBoth)):
    tmp = []
    for j in range(len(workMasterCodePerElementFromBoth[i])):
        a = workMasterCodePerElementFromBoth[i][j] +": "+ specPerElement[i][j]
        tmp.append(a)
    fullWMCodeDescriptionPerElement.append(tmp)

fullWMinfo = {
"AllElement": inputElements,
"WorkMasterCodePerFamilyType": dic_FamilyCodeandWM,
"WorkMasterCodePerElementBoth": workMasterCodePerElementFromBoth,
"FullWMCodeDescriptionPerElement": fullWMCodeDescriptionPerElement
}



result = fullWMinfo

# Assign your output to the OUT variable.
OUT = result
# ----------------------------------------

# group: Organize AllElementInform AsDictionary
set_up_all_element_inform_as = Python(IN[0]=excelDataManagerNode)  # "Set Up All Element Inform as Dictionary"; CPython3
# ---------- set_up_all_element_inform_as.python (119 lines) ----------
# Load the Python Standard and DesignScript Libraries
import os
import sys
sys.path.append(os.getenv('LOCALAPPDATA').replace('\\','\\\\') + r'\Programs\Python\Python39\Lib\site-packages')
import clr
clr.AddReference('RevitAPI')
import Autodesk

clr.AddReference('ProtoGeometry')
from Autodesk.DesignScript.Geometry import *

clr.AddReference('RevitNodes')
import Revit
clr.ImportExtensions(Revit.Elements)

clr.ImportExtensions(Revit.GeometryConversion)
clr.ImportExtensions(Revit.GeometryReferences)

clr.AddReference('RevitServices')
import RevitServices
from RevitServices.Persistence import DocumentManager
from RevitServices.Transactions import TransactionManager

doc = DocumentManager.Instance.CurrentDBDocument

import random
import itertools
from functools import reduce
from collections import Iterable
import datetime
import openpyxl

def iterable(obj):
    return isinstance(obj, Iterable)

def findUnique(inputs):
    result = []
    for i in inputs:
        if i in result:
            pass
        else:
            result.append(i)
    return result

# The inputs to this node will be stored as a list in the IN variables.
dataEnteringNode = IN
inputDict = IN[0]


def importExcel(path, SheetNameIn):
    wb_obj = openpyxl.load_workbook(str(path), data_only=True)
    sheet_obj = wb_obj.get_sheet_by_name(str(SheetNameIn))

    m_row = sheet_obj.max_row
    m_col = sheet_obj.max_column

    listOut = []

    for i in range(1, m_row +1):
        listTemp = []
        for j in range(1, m_col + 1):
            cell_obj = sheet_obj.cell(row=i, column=j)
            listTemp.append(cell_obj.value)
            if len(listTemp) == m_col:
                listOut.append(listTemp)
    return listOut

def getUsedFamilyTypeOfModeling(elements):
    familyCode = list(map(lambda x: x.Name.split('_')[0], elements))
    unq_familyCode = findUnique(familyCode)
    return unq_familyCode
    
def createExcelDataDictionary(values):
    result = {}
    for i in range(len(values)):
        result[str(i)] = values[i]
    return result

def findTargetIndex(targets, list):
    result = []
    for target in targets:
        for i in range(len(list)):
            if target in str(list[i]):
                result.append(i)
            else:
                pass
    result.sort()
    return result
    
def GetValueAtKeys(keys, dictionary):
    result = [] 
    for i in keys:
        result.append(dictionary[str(i)])
    return result


# Place your code below this line
element = inputDict["AllElement"]
elementType = []
for i in element:
    elementType.append(i.Name)
familyCode = []
for i in elementType:
    familyCode.append(i.split("_")[0])
fullWMCodeDescriptionPerElement = inputDict["FullWMCodeDescriptionPerElement"]

resultDict = {
"Element": element,
"ElementType": elementType,
"FamilyCode": familyCode,
"FullWMCodeDescriptionPerElement": fullWMCodeDescriptionPerElement
}



result = resultDict

# Assign your output to the OUT variable.
OUT = result
# ----------------------------------------

# group: 패밀리 타입 확인용
code_block_2 = CodeBlock(i=set_up_all_element_inform_as) { i["ElementType"]; }
uniqueItems = List.UniqueItems(list=code_block_2)

# group: create Element DataStructure
createElemDS = Python(IN[0]=set_up_all_element_inform_as)  # CPython3
# ---------- createElemDS.python (47 lines) ----------
# Load the Python Standard and DesignScript Libraries
import sys
import clr
clr.AddReference('ProtoGeometry')
from Autodesk.DesignScript.Geometry import *

# The inputs to this node will be stored as a list in the IN variables.
dataEnteringNode = IN
elemDics = IN[0]
elems = elemDics["Element"]
elemTypes = elemDics["ElementType"]
WMperElems = elemDics["FullWMCodeDescriptionPerElement"]
idx = range(len(elems))
# Place your code below this line
def ElemDS(i, elems, elemTypes, WMperElems):
    elem = elems[i]
    elemType = elemTypes[i]
    familyCode = elemType.split('_')[0]
    WMperElem = WMperElems[i]
    familyClass = elem.ElementType.GetParameterValueByName("Family Name")
    
    def findLevel():
        if "Wall" in familyClass:
            level = elem.GetParameterValueByName("Base Constraint")
        elif "Column" in familyClass:
            level = elem.GetParameterValueByName("Base Level")
        elif "Stair" in familyClass:
            level = elem.GetParameterValueByName("Base Level")
        elif "Beam" in familyClass:
            level = elem.GetParameterValueByName("Reference Level")
        else:
            level = elem.GetParameterValueByName("Level")
        return level
    level = findLevel()
    
    result = {
        "elem": elem,
        "elemType": elemType,
        "level": level,
        "familyCode": familyCode,
        "WMperElem": WMperElem,
    }
    
    return result

# Assign your output to the OUT variable.
OUT = [ElemDS(i, elems, elemTypes, WMperElems) for i in idx]
# ----------------------------------------

# group: 함수 인풋값
독립기초철근비 = DoubleInput(0.1)  # graph input
슬라브철근비 = DoubleInput(0.15)  # graph input
패드철근비 = DoubleInput(0.1)  # graph input
매스콘크리트철근비 = DoubleInput(0.2)  # graph input
경사_비율_입력_1_x_for_isofdn = DoubleInput(2)  # graph input
온통_터파기_여부 = BoolSelector(false)  # graph input
터파기_하부_offset = DoubleInput(300)  # graph input
버림thk = DoubleInput(50)  # graph input
토량_환산_계수 = DoubleInput(1.2)  # graph input
버림offset = DoubleInput(100)  # graph input
code_block_3 = CodeBlock(독립기초철근비=독립기초철근비, 슬라브철근비=슬라브철근비, 패드철근비=패드철근비, 매스콘크리트철근비=매스콘크리트철근비, 경사비율_IsoFDN=경사_비율_입력_1_x_for_isofdn, 온통터파기_여부=온통_터파기_여부, 터파기_하부Offset=터파기_하부_offset, 버림thk=버림thk, 토량_환산계수=토량_환산_계수, 버림offset=버림offset)
# ---------- code_block_3.designscript (12 lines) ----------
i = {
"독립기초철근비": 독립기초철근비,
"슬라브철근비": 슬라브철근비,
"패드철근비": 패드철근비,
"매스콘크리트철근비": 매스콘크리트철근비,
"경사비율_IsoFDN": 경사비율_IsoFDN,
"온통터파기_여부": 온통터파기_여부,
"터파기_하부Offset": 터파기_하부Offset,
"버림thk": 버림thk,
"토량_환산계수": 토량_환산계수,
"버림offset": 버림offset
};
# ----------------------------------------

# group: 콘크리트물량산출함수
familytype_tag = CodeBlock()
# ---------- familytype_tag.designscript (3 lines) ----------
[
"CL"
];
# ----------------------------------------
wbs_tag = CodeBlock()
# ---------- wbs_tag.designscript (6 lines) ----------
[
"A03AC032",
"A03AD032",
"A03AF032",
"A03AG032"
];
# ----------------------------------------
# note: refFunc = IN[0]
# tag = IN[1]
# input = IN[2]
tag_전달_및_함수인풋값_전달 = CodeBlock(i=familytype_tag, j=wbs_tag, r=code_block_3) { List.Join([[i],[j]]); test; r; }  # unwired: test
콘크리트물량산출함수 = Python(IN[1]=tag_전달_및_함수인풋값_전달.out0, IN[2]=tag_전달_및_함수인풋값_전달.test)  # CPython3; unwired: IN[0]
# ---------- 콘크리트물량산출함수.python (77 lines) ----------
# Load the Python Standard and DesignScript Libraries
import sys
import clr
clr.AddReference('RevitAPI')
from Autodesk.Revit.DB import *
import Autodesk

clr.AddReference('RevitNodes')
import Revit
clr.ImportExtensions(Revit.Elements)

clr.AddReference('RevitServices')
import RevitServices
from RevitServices.Persistence import DocumentManager
doc = DocumentManager.Instance.CurrentDBDocument
collector1 = FilteredElementCollector(doc)
collector2 = FilteredElementCollector(doc)
collector3 = FilteredElementCollector(doc)
collector4 = FilteredElementCollector(doc)
collector5 = FilteredElementCollector(doc)

clr.AddReference('ProtoGeometry')
from Autodesk.DesignScript.Geometry import *

from itertools import chain

allFdns = collector1.OfCategory(BuiltInCategory.OST_StructuralFoundation).WhereElementIsNotElementType().ToElements()
allCols = collector2.OfCategory(BuiltInCategory.OST_StructuralColumns).WhereElementIsNotElementType().ToElements()
allBeams = collector3.OfCategory(BuiltInCategory.OST_StructuralFraming).WhereElementIsNotElementType().ToElements()
allFloors = collector4.OfCategory(BuiltInCategory.OST_Floors).WhereElementIsNotElementType().ToElements()
_allEdges = collector5.OfCategory(BuiltInCategory.OST_EdgeSlab).WhereElementIsNotElementType().ToElements()
allIsoFdns = [i.ToDSType(False) for i in allFdns if "Footing-" in i.Name]
allPeds = [i.ToDSType(False) for i in allCols if "UG" in i.Name]
allPedsGeo = [i.Geometry()[0] for i in allPeds]
allTGs = [i.ToDSType(False) for i in allBeams if "UG" in i.Name]
allTGsGeo = [i.Geometry()[0] for i in allTGs]
allSOGs = [i.ToDSType(False) for i in allFdns if "SOG" in i.Name and "GS" in i.Name]
allSOGsGeo = [i.Geometry()[0] for i in allSOGs]
allEdges = [i.ToDSType(False) for i in _allEdges] + [i.ToDSType(False) for i in allFdns if "HAUNCH" in i.Name and "GS" in i.Name]
allEdgesGeo = [i.Geometry()[0] for i in allEdges]
allFdnAndHaunch = [i.ToDSType(False) for i in allFdns+_allEdges]
allFdnAndHaunchGeo = list(chain(*[i.Geometry() for i in allFdnAndHaunch]))
#allFdnAndHaunchGeo = [i.Geometry()[0] for i in allFdnAndHaunch]
# The inputs to this node will be stored as a list in the IN variables.
dataEnteringNode = IN

refFunc = IN[0]
tag = IN[1]
input = IN[2]

# Place your code below this line
def 콘크리트물량산출함수(input):
    if "Footing-Rectangular" in input.Name:
        target = input
        targetGeo = target.Geometry()[0]
        targetValue = target.GetParameterValueByName("Volume")
        
    elif "CL" in input.Name:
        target = input
        targetGeo = target.Geometry()[0]
        targetValue = target.GetParameterValueByName("Volume")

    else:
        inputGeo = input.Geometry()[0]
        분해요소들 = inputGeo.Explode()
        접촉판별면 = [i for i in 분해요소들 if round(i.NormalAtParameter(0.5,0.5).Z)==-1][0]
        접촉대상 = [i for i in allEdgesGeo + allFdnAndHaunchGeo if 접촉판별면.DoesIntersect(i)]
        산출대상 = [inputGeo] + 접촉대상
        
        target = Solid.ByUnion(산출대상)
        targetGeo = target
        targetValue = target.Volume/1000000000
        
    return (targetGeo, targetValue, "M3")

# Assign your output to the OUT variable.
OUT = (콘크리트물량산출함수,tag[0],tag[1],["M3"])
# ----------------------------------------

# group: 철근물량산출함수
familytype_tag_2 = CodeBlock()  # same code as familytype_tag
wbs_tag_2 = CodeBlock()
# ---------- wbs_tag_2.designscript (6 lines) ----------
[
"A03AC037",
"A03AD037",
"A03AF037",
"A03AG037"
];
# ----------------------------------------
# note: refFunc = IN[0]
# tag = IN[1]
# input = IN[2]
tag_전달_및_함수인풋값_전달_2 = CodeBlock(i=familytype_tag_2, j=wbs_tag_2, r=code_block_3) { List.Join([[i],[j]]); test; r; r["독립기초철근비"]; r["슬라브철근비"]; r["패드철근비"]; r["매스콘크리트철근비"]; }  # unwired: test
철근물량산출함수 = Python(IN[0]=콘크리트물량산출함수, IN[1]=tag_전달_및_함수인풋값_전달_2.out0, IN[2]=tag_전달_및_함수인풋값_전달_2.test, IN[3]=tag_전달_및_함수인풋값_전달_2.out3, IN[4]=tag_전달_및_함수인풋값_전달_2.out4, IN[5]=tag_전달_및_함수인풋값_전달_2.out5, IN[6]=tag_전달_및_함수인풋값_전달_2.out6)  # CPython3
# ---------- 철근물량산출함수.python (97 lines) ----------
# Load the Python Standard and DesignScript Libraries
import sys
import clr
clr.AddReference('RevitAPI')
from Autodesk.Revit.DB import *
import Autodesk

clr.AddReference('RevitNodes')
import Revit
clr.ImportExtensions(Revit.Elements)

clr.AddReference('RevitServices')
import RevitServices
from RevitServices.Persistence import DocumentManager
doc = DocumentManager.Instance.CurrentDBDocument
collector1 = FilteredElementCollector(doc)
collector2 = FilteredElementCollector(doc)
collector3 = FilteredElementCollector(doc)
collector4 = FilteredElementCollector(doc)
collector5 = FilteredElementCollector(doc)

clr.AddReference('ProtoGeometry')
from Autodesk.DesignScript.Geometry import *

from itertools import chain

allFdns = collector1.OfCategory(BuiltInCategory.OST_StructuralFoundation).WhereElementIsNotElementType().ToElements()
allCols = collector2.OfCategory(BuiltInCategory.OST_StructuralColumns).WhereElementIsNotElementType().ToElements()
allBeams = collector3.OfCategory(BuiltInCategory.OST_StructuralFraming).WhereElementIsNotElementType().ToElements()
allFloors = collector4.OfCategory(BuiltInCategory.OST_Floors).WhereElementIsNotElementType().ToElements()
_allEdges = collector5.OfCategory(BuiltInCategory.OST_EdgeSlab).WhereElementIsNotElementType().ToElements()
allIsoFdns = [i.ToDSType(False) for i in allFdns if "Footing-" in i.Name]
allPeds = [i.ToDSType(False) for i in allCols if "UG" in i.Name]
allPedsGeo = [i.Geometry()[0] for i in allPeds]
allTGs = [i.ToDSType(False) for i in allBeams if "TG" in i.Name]
allTGsGeo = [i.Geometry()[0] for i in allTGs]
allSOGs = [i.ToDSType(False) for i in allFdns if "SOG" in i.Name and "GS" in i.Name]
allSOGsGeo = [i.Geometry()[0] for i in allSOGs]
allEdges = [i.ToDSType(False) for i in _allEdges]
allEdgesGeo = [i.Geometry()[0] for i in allEdges]
allFdnAndHaunch = [i.ToDSType(False) for i in allFdns+_allEdges]
allFdnAndHaunchGeo = list(chain(*[i.Geometry() for i in allFdnAndHaunch]))
#allFdnAndHaunchGeo = [i.Geometry()[0] for i in allFdnAndHaunch]
# The inputs to this node will be stored as a list in the IN variables.
dataEnteringNode = IN

refFunc = IN[0]
tag = IN[1]
input = IN[2]

독립기초철근비 = IN[3]
슬라브철근비 = IN[4]
패드철근비 = IN[5]
매스콘크리트철근비 = IN[6]

# Place your code below this line
def 철근물량산출함수(input):
    콘크리트물량산출함수 = refFunc[0]
    if "Footing-Rectangular" in input.Name:
        ratio = 독립기초철근비
        
        target = 콘크리트물량산출함수(input)[0]
        targetGeo = "형상정보 미제공"
        targetValue = target.Volume*ratio/1000000000
    
    elif "SOG" in input.Name or "SL" in input.Name:
        ratio = 슬라브철근비
        
        target = 콘크리트물량산출함수(input)[0]
        targetGeo = "형상정보 미제공"
        targetValue = target.Volume*ratio/1000000000
        
    elif "PAD" in input.Name or "EF" in input.Name:
        ratio = 패드철근비
        
        target = 콘크리트물량산출함수(input)[0]
        targetGeo = "형상정보 미제공"
        targetValue = target.Volume*ratio/1000000000
        
    elif "MASS" in input.Name or "MAT" in input.Name:
        ratio = 매스콘크리트철근비
        
        target = 콘크리트물량산출함수(input)[0]
        targetGeo = "형상정보 미제공"
        targetValue = target.Volume*ratio/1000000000

    else:
        ratio = 패드철근비
        
        target = 콘크리트물량산출함수(input)[0]
        targetGeo = "형상정보 미제공"
        targetValue = target.Volume*ratio/1000000000
    
    return (targetGeo, targetValue, "TON")

# Assign your output to the OUT variable.
OUT = (철근물량산출함수,tag[0],tag[1],["TON"])
# ----------------------------------------

# group: 거푸집산출함수
familytype_tag_3 = CodeBlock()  # same code as familytype_tag
wbs_tag_3 = CodeBlock()
# ---------- wbs_tag_3.designscript (10 lines) ----------
[
"A03AC035",
"A03AD035",
"A03AF035",
"A03AG035",
"A03AC036",
"A03AD036",
"A03AF036",
"A03AG036"
];
# ----------------------------------------
# note: refFunc = IN[0]
# tag = IN[1]
# input = IN[2]
tag_전달_및_함수인풋값_전달_3 = CodeBlock(i=familytype_tag_3, j=wbs_tag_3, r=code_block_3) { List.Join([[i],[j]]); test; r; }  # unwired: test
거푸집산출함수 = Python(IN[1]=tag_전달_및_함수인풋값_전달_3.out0, IN[2]=tag_전달_및_함수인풋값_전달_3.test)  # CPython3; unwired: IN[0]
# ---------- 거푸집산출함수.python (43 lines) ----------
# Load the Python Standard and DesignScript Libraries
import sys
import clr
clr.AddReference('RevitAPI')
from Autodesk.Revit.DB import *
import Autodesk

clr.AddReference('RevitNodes')
import Revit
clr.ImportExtensions(Revit.Elements)

clr.AddReference('RevitServices')
import RevitServices
from RevitServices.Persistence import DocumentManager
doc = DocumentManager.Instance.CurrentDBDocument
collector = FilteredElementCollector(doc)#Autodesk.Revit.DB.FilteredElementCollector(doc)

clr.AddReference('ProtoGeometry')
from Autodesk.DesignScript.Geometry import *

from itertools import chain

# The inputs to this node will be stored as a list in the IN variables.
dataEnteringNode = IN

refFunc = IN[0]
tag = IN[1]
input = IN[2]

# Place your code below this line
def 거푸집산출함수(input):
    inputGeo = input.Geometry()[0]
    표면들 = inputGeo.Explode()
    측면들 = [i for i in 표면들 if round(i.NormalAtParameter(0.5,0.5).Z, 2)==0]
    
    target = 측면들
    targetGeo = target
    targetValue = sum([i.Area for i in target])/1000000
    
    return (targetGeo, targetValue, "M2")

# Assign your output to the OUT variable.
OUT = (거푸집산출함수,tag[0],tag[1],["M2"])
# ----------------------------------------

# group: 프로텍션보드산출함수
familytype_tag_4 = CodeBlock()
# ---------- familytype_tag_4.designscript (4 lines) ----------
[
//"CL"
"PEDESTAL_UG"
];
# ----------------------------------------
wbs_tag_4 = CodeBlock()
# ---------- wbs_tag_4.designscript (3 lines) ----------
[
"A03AE060"
];
# ----------------------------------------
# note: refFunc = IN[0]
# tag = IN[1]
# input = IN[2]
tag_전달_및_함수인풋값_전달_4 = CodeBlock(i=familytype_tag_4, j=wbs_tag_4, r=code_block_3) { List.Join([[i],[j]]); test; r; }  # unwired: test
프로텍션보드산출함수 = Python(IN[1]=tag_전달_및_함수인풋값_전달_4.out0, IN[2]=tag_전달_및_함수인풋값_전달_4.test)  # CPython3; unwired: IN[0]
# ---------- 프로텍션보드산출함수.python (78 lines) ----------
# Load the Python Standard and DesignScript Libraries
import sys
import clr

clr.AddReference('RevitAPI')
from Autodesk.Revit.DB import *
import Autodesk

clr.AddReference('RevitNodes')
import Revit
clr.ImportExtensions(Revit.Elements)

clr.AddReference('RevitServices')
import RevitServices
from RevitServices.Persistence import DocumentManager
doc = DocumentManager.Instance.CurrentDBDocument
collector1 = FilteredElementCollector(doc)
collector2 = FilteredElementCollector(doc)
collector3 = FilteredElementCollector(doc)
collector4 = FilteredElementCollector(doc)

clr.AddReference('ProtoGeometry')
from Autodesk.DesignScript.Geometry import *

from itertools import chain

allFdns = collector1.OfCategory(BuiltInCategory.OST_StructuralFoundation).WhereElementIsNotElementType().ToElements()
allCols = collector2.OfCategory(BuiltInCategory.OST_StructuralColumns).WhereElementIsNotElementType().ToElements()
allBeams = collector3.OfCategory(BuiltInCategory.OST_StructuralFraming).WhereElementIsNotElementType().ToElements()
allFloors = collector4.OfCategory(BuiltInCategory.OST_Floors).WhereElementIsNotElementType().ToElements()
allIsoFdns = [i.ToDSType(False) for i in allFdns if "Footing-" in i.Name]
allIsoFdnsGeo = [i.Geometry()[0] for i in allIsoFdns]
allPeds = [i.ToDSType(False) for i in allCols if "UG" in i.Name]
allPedsGeo = [i.Geometry()[0] for i in allPeds]
allTGs = [i.ToDSType(False) for i in allBeams if "TG" in i.Name]
allTGsGeo = [i.Geometry()[0] for i in allTGs]
allSOGs = [i.ToDSType(False) for i in allFdns if "SOG" in i.Name and "GS" in i.Name]
allSOGsGeo = [i.Geometry()[0] for i in allSOGs]

# The inputs to this node will be stored as a list in the IN variables.
dataEnteringNode = IN

refFunc = IN[0]
tag = IN[1]
input = IN[2]

# Place your code below this line

def 프로텍션보드산출함수(input):
    
    if "CL" in input.Name:
        calcTargetNum = 1
        inputGeo = input.Geometry()[0]
        표면들 = inputGeo.Explode()
        측면들 = [i for i in 표면들 if round(i.NormalAtParameter(0.5,0.5).Z,2)==0]
        target = 측면들
        targetGeo = target
        targetValue = sum([i.Area for i in target])/calcTargetNum/1000000
        
    else:
        calcTargetNum = 1
        inputGeo = input.Geometry()[0]
        표면들 = inputGeo.Explode()
        기초상부면 = [i for i in 표면들 if round(i.NormalAtParameter(0.5,0.5).Z,2) == 1][0]
        기초측면들 = [i for i in 표면들 if round(i.NormalAtParameter(0.5,0.5).Z,2)==0]
        _접촉페데스탈 = [i for i in allPedsGeo if i.DoesIntersect(inputGeo)]
        접촉페데스탈 = Solid.ByUnion(_접촉페데스탈)
        상부면_공제 = 기초상부면.SubtractFrom(접촉페데스탈)[0]
        target = 기초측면들 + [상부면_공제]
        targetGeo = target
        targetValue = sum([i.Area for i in target])/calcTargetNum/1000000
    
        #return target
    return (targetGeo, targetValue, "M2")

# Assign your output to the OUT variable.
#OUT = 프로텍션보드산출함수(input)
OUT = (프로텍션보드산출함수,tag[0],tag[1],["M2"])
# ----------------------------------------

# group: 시트멤브레인산출함수
familytype_tag_5 = CodeBlock()
# ---------- familytype_tag_5.designscript (3 lines) ----------
[
"PEDESTAL_UG"
];
# ----------------------------------------
wbs_tag_5 = CodeBlock()
# ---------- wbs_tag_5.designscript (3 lines) ----------
[
"A03AE059"
];
# ----------------------------------------
# note: refFunc = IN[0]
# tag = IN[1]
# input = IN[2]
tag_전달_및_함수인풋값_전달_5 = CodeBlock(i=familytype_tag_5, j=wbs_tag_5, r=code_block_3) { List.Join([[i],[j]]); test; r; }  # unwired: test
시트멤브레인산출함수 = Python(IN[0]=프로텍션보드산출함수, IN[1]=tag_전달_및_함수인풋값_전달_5.out0, IN[2]=tag_전달_및_함수인풋값_전달_5.test)  # CPython3
# ---------- 시트멤브레인산출함수.python (77 lines) ----------
# Load the Python Standard and DesignScript Libraries
import sys
import clr

clr.AddReference('RevitAPI')
from Autodesk.Revit.DB import *
import Autodesk

clr.AddReference('RevitNodes')
import Revit
clr.ImportExtensions(Revit.Elements)

clr.AddReference('RevitServices')
import RevitServices
from RevitServices.Persistence import DocumentManager
doc = DocumentManager.Instance.CurrentDBDocument
collector1 = FilteredElementCollector(doc)
collector2 = FilteredElementCollector(doc)
collector3 = FilteredElementCollector(doc)
collector4 = FilteredElementCollector(doc)
collector5 = FilteredElementCollector(doc)

clr.AddReference('ProtoGeometry')
from Autodesk.DesignScript.Geometry import *

from itertools import chain

allFdns = collector1.OfCategory(BuiltInCategory.OST_StructuralFoundation).WhereElementIsNotElementType().ToElements()
allCols = collector2.OfCategory(BuiltInCategory.OST_StructuralColumns).WhereElementIsNotElementType().ToElements()
allBeams = collector3.OfCategory(BuiltInCategory.OST_StructuralFraming).WhereElementIsNotElementType().ToElements()
allFloors = collector4.OfCategory(BuiltInCategory.OST_Floors).WhereElementIsNotElementType().ToElements()
_allEdges = collector5.OfCategory(BuiltInCategory.OST_EdgeSlab).WhereElementIsNotElementType().ToElements()
allIsoFdns = [i.ToDSType(False) for i in allFdns if "Footing-" in i.Name]
allPeds = [i.ToDSType(False) for i in allCols if "UG" in i.Name]
allPedsGeo = [i.Geometry()[0] for i in allPeds]
allTGs = [i.ToDSType(False) for i in allBeams if "TG" in i.Name]
allTGsGeo = [i.Geometry()[0] for i in allTGs]
allSOGs = [i.ToDSType(False) for i in allFdns if "SOG" in i.Name and "GS" in i.Name]
allSOGsGeo = [i.Geometry()[0] for i in allSOGs]
allEdges = [i.ToDSType(False) for i in _allEdges]
allEdgesGeo = [i.Geometry()[0] for i in allEdges]
allFdnAndHaunch = [i.ToDSType(False) for i in allFdns+_allEdges]
allFdnAndHaunchGeo = list(chain(*[i.Geometry() for i in allFdnAndHaunch]))
#allFdnAndHaunchGeo = [i.Geometry()[0] for i in allFdnAndHaunch]

# The inputs to this node will be stored as a list in the IN variables.
dataEnteringNode = IN

refFunc = IN[0]
tag = IN[1]
input = IN[2]

# Place your code below this line
def getIdxOfMaximum(list):
    result = []
    maxValue = max(list)
    for i in range(len(list)):
        if list[i]==maxValue:
            result.append(i)
    return result

def 시트멤브레인산출함수(input):
    프로텍션보드산출함수 = refFunc[0]
    calcTargetNum = 1
    
    프로텍션보드적용면들 = 프로텍션보드산출함수(input)[0]

    target = 프로텍션보드적용면들
    targetGeo = target
    targetValue = sum([i.Area for i in target])/calcTargetNum/1000000

    #return target
    return (targetGeo, targetValue, "M2")

# Assign your output to the OUT variable.
#OUT = PE시트산출함수(input)
OUT = (시트멤브레인산출함수,tag[0],tag[1],["M2"])
# ----------------------------------------

# group: 철골물량산출함수_Heavy
familytype_tag_6 = CodeBlock()  # same code as familytype_tag
wbs_tag_6 = CodeBlock()
# ---------- wbs_tag_6.designscript (4 lines) ----------
[
"S01AA001",
"S03AA027"
];
# ----------------------------------------
# note: refFunc = IN[0]
# tag = IN[1]
# input = IN[2]
tag_전달_및_함수인풋값_전달_6 = CodeBlock(i=familytype_tag_6, j=wbs_tag_6, r=tag_전달_및_함수인풋값_전달.r) { List.Join([[i],[j]]); test; r; }  # unwired: test
철골물량산출함수_Heavy = Python(IN[1]=tag_전달_및_함수인풋값_전달_6.out0, IN[2]=tag_전달_및_함수인풋값_전달_6.test)  # CPython3; unwired: IN[0]
# ---------- 철골물량산출함수_Heavy.python (73 lines) ----------
# Load the Python Standard and DesignScript Libraries
import sys
import clr
clr.AddReference('RevitAPI')
from Autodesk.Revit.DB import *
import Autodesk

clr.AddReference('RevitNodes')
import Revit
clr.ImportExtensions(Revit.Elements)

clr.AddReference('RevitServices')
import RevitServices
from RevitServices.Persistence import DocumentManager
doc = DocumentManager.Instance.CurrentDBDocument
collector1 = FilteredElementCollector(doc)
collector2 = FilteredElementCollector(doc)
collector3 = FilteredElementCollector(doc)
collector4 = FilteredElementCollector(doc)
collector5 = FilteredElementCollector(doc)

clr.AddReference('ProtoGeometry')
from Autodesk.DesignScript.Geometry import *

from itertools import chain

allFdns = collector1.OfCategory(BuiltInCategory.OST_StructuralFoundation).WhereElementIsNotElementType().ToElements()
allCols = collector2.OfCategory(BuiltInCategory.OST_StructuralColumns).WhereElementIsNotElementType().ToElements()
allBeams = collector3.OfCategory(BuiltInCategory.OST_StructuralFraming).WhereElementIsNotElementType().ToElements()
allFloors = collector4.OfCategory(BuiltInCategory.OST_Floors).WhereElementIsNotElementType().ToElements()
_allEdges = collector5.OfCategory(BuiltInCategory.OST_EdgeSlab).WhereElementIsNotElementType().ToElements()
allIsoFdns = [i.ToDSType(False) for i in allFdns if "Footing-" in i.Name]
allPeds = [i.ToDSType(False) for i in allCols if "UG" in i.Name]
allPedsGeo = [i.Geometry()[0] for i in allPeds]
allTGs = [i.ToDSType(False) for i in allBeams if "UG" in i.Name]
allTGsGeo = [i.Geometry()[0] for i in allTGs]
allSOGs = [i.ToDSType(False) for i in allFdns if "SOG" in i.Name and "GS" in i.Name]
allSOGsGeo = [i.Geometry()[0] for i in allSOGs]
allEdges = [i.ToDSType(False) for i in _allEdges] + [i.ToDSType(False) for i in allFdns if "HAUNCH" in i.Name and "GS" in i.Name]
allEdgesGeo = [i.Geometry()[0] for i in allEdges]
allFdnAndHaunch = [i.ToDSType(False) for i in allFdns+_allEdges]
allFdnAndHaunchGeo = list(chain(*[i.Geometry() for i in allFdnAndHaunch]))
#allFdnAndHaunchGeo = [i.Geometry()[0] for i in allFdnAndHaunch]
# The inputs to this node will be stored as a list in the IN variables.
dataEnteringNode = IN

refFunc = IN[0]
tag = IN[1]
input = IN[2]

# Place your code below this line
def 철골물량산출함수_Heavy(input):
    if "Heavy" in input.ElementType.GetParameterValueByName("SteelWeight"):
        단위길이당중량 = input.ElementType.GetParameterValueByName("Mass per Unit Length")
        상단높이 = input.GetParameterValueByName("Top Level").Elevation + input.GetParameterValueByName("Top Offset")
        하단높이 = input.GetParameterValueByName("Base Level").Elevation + input.GetParameterValueByName("Base Offset")
#        철골길이 = (상단높이 - 하단높이)/1000
        철골체적 = input.GetParameterValueByName("Volume") #m3
        철골단면적 = input.ElementType.GetParameterValueByName("Section Area")/10000 #cm2 => m2
        철골길이 = 철골체적/철골단면적
        target = input
        targetGeo = target.Geometry()[0]
        targetValue = 단위길이당중량 * 철골길이/1000

    else:
        target = "-!!적용대상이 아님!!-"
        targetGeo = "-!!적용대상이 아님!!-"
        targetValue = "-!!적용대상이 아님!!-"
        
    return (targetGeo, targetValue, "TON")

# Assign your output to the OUT variable.
OUT = (철골물량산출함수_Heavy,tag[0],tag[1],["TON"])
# ----------------------------------------

# group: 철골물량산출함수_Medium
familytype_tag_7 = CodeBlock()  # same code as familytype_tag
wbs_tag_7 = CodeBlock()
# ---------- wbs_tag_7.designscript (4 lines) ----------
[
"S01AA002",
"S03AA028"
];
# ----------------------------------------
# note: refFunc = IN[0]
# tag = IN[1]
# input = IN[2]
tag_전달_및_함수인풋값_전달_7 = CodeBlock(i=familytype_tag_7, j=wbs_tag_7, r=tag_전달_및_함수인풋값_전달.r) { List.Join([[i],[j]]); test; r; }  # unwired: test
철골물량산출함수_Medium = Python(IN[1]=tag_전달_및_함수인풋값_전달_7.out0, IN[2]=tag_전달_및_함수인풋값_전달_7.test)  # CPython3; unwired: IN[0]
# ---------- 철골물량산출함수_Medium.python (73 lines) ----------
# Load the Python Standard and DesignScript Libraries
import sys
import clr
clr.AddReference('RevitAPI')
from Autodesk.Revit.DB import *
import Autodesk

clr.AddReference('RevitNodes')
import Revit
clr.ImportExtensions(Revit.Elements)

clr.AddReference('RevitServices')
import RevitServices
from RevitServices.Persistence import DocumentManager
doc = DocumentManager.Instance.CurrentDBDocument
collector1 = FilteredElementCollector(doc)
collector2 = FilteredElementCollector(doc)
collector3 = FilteredElementCollector(doc)
collector4 = FilteredElementCollector(doc)
collector5 = FilteredElementCollector(doc)

clr.AddReference('ProtoGeometry')
from Autodesk.DesignScript.Geometry import *

from itertools import chain

allFdns = collector1.OfCategory(BuiltInCategory.OST_StructuralFoundation).WhereElementIsNotElementType().ToElements()
allCols = collector2.OfCategory(BuiltInCategory.OST_StructuralColumns).WhereElementIsNotElementType().ToElements()
allBeams = collector3.OfCategory(BuiltInCategory.OST_StructuralFraming).WhereElementIsNotElementType().ToElements()
allFloors = collector4.OfCategory(BuiltInCategory.OST_Floors).WhereElementIsNotElementType().ToElements()
_allEdges = collector5.OfCategory(BuiltInCategory.OST_EdgeSlab).WhereElementIsNotElementType().ToElements()
allIsoFdns = [i.ToDSType(False) for i in allFdns if "Footing-" in i.Name]
allPeds = [i.ToDSType(False) for i in allCols if "UG" in i.Name]
allPedsGeo = [i.Geometry()[0] for i in allPeds]
allTGs = [i.ToDSType(False) for i in allBeams if "UG" in i.Name]
allTGsGeo = [i.Geometry()[0] for i in allTGs]
allSOGs = [i.ToDSType(False) for i in allFdns if "SOG" in i.Name and "GS" in i.Name]
allSOGsGeo = [i.Geometry()[0] for i in allSOGs]
allEdges = [i.ToDSType(False) for i in _allEdges] + [i.ToDSType(False) for i in allFdns if "HAUNCH" in i.Name and "GS" in i.Name]
allEdgesGeo = [i.Geometry()[0] for i in allEdges]
allFdnAndHaunch = [i.ToDSType(False) for i in allFdns+_allEdges]
allFdnAndHaunchGeo = list(chain(*[i.Geometry() for i in allFdnAndHaunch]))
#allFdnAndHaunchGeo = [i.Geometry()[0] for i in allFdnAndHaunch]
# The inputs to this node will be stored as a list in the IN variables.
dataEnteringNode = IN

refFunc = IN[0]
tag = IN[1]
input = IN[2]

# Place your code below this line
def 철골물량산출함수_Medium(input):
    if "Medium" in input.ElementType.GetParameterValueByName("SteelWeight"):
        단위길이당중량 = input.ElementType.GetParameterValueByName("Mass per Unit Length")
        상단높이 = input.GetParameterValueByName("Top Level").Elevation + input.GetParameterValueByName("Top Offset")
        하단높이 = input.GetParameterValueByName("Base Level").Elevation + input.GetParameterValueByName("Base Offset")
#        철골길이 = (상단높이 - 하단높이)/1000
        철골체적 = input.GetParameterValueByName("Volume") #m3
        철골단면적 = input.ElementType.GetParameterValueByName("Section Area")/10000 #cm2 => m2
        철골길이 = 철골체적/철골단면적
        target = input
        targetGeo = target.Geometry()[0]
        targetValue = 단위길이당중량 * 철골길이/1000

    else:
        target = "-!!적용대상이 아님!!-"
        targetGeo = "-!!적용대상이 아님!!-"
        targetValue = "-!!적용대상이 아님!!-"
        
    return (targetGeo, targetValue, "TON")

# Assign your output to the OUT variable.
OUT = (철골물량산출함수_Medium,tag[0],tag[1],["TON"])
# ----------------------------------------

# group: 철골물량산출함수_Light
familytype_tag_8 = CodeBlock()  # same code as familytype_tag
wbs_tag_8 = CodeBlock()
# ---------- wbs_tag_8.designscript (4 lines) ----------
[
"S01AA003",
"S03AA029"
];
# ----------------------------------------
# note: refFunc = IN[0]
# tag = IN[1]
# input = IN[2]
tag_전달_및_함수인풋값_전달_8 = CodeBlock(i=familytype_tag_8, j=wbs_tag_8, r=tag_전달_및_함수인풋값_전달_2.r) { List.Join([[i],[j]]); test; r; }  # unwired: test
철골물량산출함수_Light = Python(IN[1]=tag_전달_및_함수인풋값_전달_8.out0, IN[2]=tag_전달_및_함수인풋값_전달_8.test)  # CPython3; unwired: IN[0]
# ---------- 철골물량산출함수_Light.python (73 lines) ----------
# Load the Python Standard and DesignScript Libraries
import sys
import clr
clr.AddReference('RevitAPI')
from Autodesk.Revit.DB import *
import Autodesk

clr.AddReference('RevitNodes')
import Revit
clr.ImportExtensions(Revit.Elements)

clr.AddReference('RevitServices')
import RevitServices
from RevitServices.Persistence import DocumentManager
doc = DocumentManager.Instance.CurrentDBDocument
collector1 = FilteredElementCollector(doc)
collector2 = FilteredElementCollector(doc)
collector3 = FilteredElementCollector(doc)
collector4 = FilteredElementCollector(doc)
collector5 = FilteredElementCollector(doc)

clr.AddReference('ProtoGeometry')
from Autodesk.DesignScript.Geometry import *

from itertools import chain

allFdns = collector1.OfCategory(BuiltInCategory.OST_StructuralFoundation).WhereElementIsNotElementType().ToElements()
allCols = collector2.OfCategory(BuiltInCategory.OST_StructuralColumns).WhereElementIsNotElementType().ToElements()
allBeams = collector3.OfCategory(BuiltInCategory.OST_StructuralFraming).WhereElementIsNotElementType().ToElements()
allFloors = collector4.OfCategory(BuiltInCategory.OST_Floors).WhereElementIsNotElementType().ToElements()
_allEdges = collector5.OfCategory(BuiltInCategory.OST_EdgeSlab).WhereElementIsNotElementType().ToElements()
allIsoFdns = [i.ToDSType(False) for i in allFdns if "Footing-" in i.Name]
allPeds = [i.ToDSType(False) for i in allCols if "UG" in i.Name]
allPedsGeo = [i.Geometry()[0] for i in allPeds]
allTGs = [i.ToDSType(False) for i in allBeams if "UG" in i.Name]
allTGsGeo = [i.Geometry()[0] for i in allTGs]
allSOGs = [i.ToDSType(False) for i in allFdns if "SOG" in i.Name and "GS" in i.Name]
allSOGsGeo = [i.Geometry()[0] for i in allSOGs]
allEdges = [i.ToDSType(False) for i in _allEdges] + [i.ToDSType(False) for i in allFdns if "HAUNCH" in i.Name and "GS" in i.Name]
allEdgesGeo = [i.Geometry()[0] for i in allEdges]
allFdnAndHaunch = [i.ToDSType(False) for i in allFdns+_allEdges]
allFdnAndHaunchGeo = list(chain(*[i.Geometry() for i in allFdnAndHaunch]))
#allFdnAndHaunchGeo = [i.Geometry()[0] for i in allFdnAndHaunch]
# The inputs to this node will be stored as a list in the IN variables.
dataEnteringNode = IN

refFunc = IN[0]
tag = IN[1]
input = IN[2]

# Place your code below this line
def 철골물량산출함수_Light(input):
    if "Light" in input.ElementType.GetParameterValueByName("SteelWeight"):
        단위길이당중량 = input.ElementType.GetParameterValueByName("Mass per Unit Length")
        상단높이 = input.GetParameterValueByName("Top Level").Elevation + input.GetParameterValueByName("Top Offset")
        하단높이 = input.GetParameterValueByName("Base Level").Elevation + input.GetParameterValueByName("Base Offset")
#        철골길이 = (상단높이 - 하단높이)/1000
        철골체적 = input.GetParameterValueByName("Volume") #m3
        철골단면적 = input.ElementType.GetParameterValueByName("Section Area")/10000 #cm2 => m2
        철골길이 = 철골체적/철골단면적
        target = input
        targetGeo = target.Geometry()[0]
        targetValue = 단위길이당중량 * 철골길이/1000

    else:
        target = "-!!적용대상이 아님!!-"
        targetGeo = "-!!적용대상이 아님!!-"
        targetValue = "-!!적용대상이 아님!!-"
        
    return (targetGeo, targetValue, "TON")

# Assign your output to the OUT variable.
OUT = (철골물량산출함수_Light,tag[0],tag[1],["TON"])
# ----------------------------------------

# group: Create funcSets
funcSets = Python(IN[0]=콘크리트물량산출함수, IN[1]=철근물량산출함수, IN[2]=거푸집산출함수, IN[3]=프로텍션보드산출함수, IN[4]=시트멤브레인산출함수)  # CPython3
# ---------- funcSets.python (13 lines) ----------
# Load the Python Standard and DesignScript Libraries
import sys
import clr
clr.AddReference('ProtoGeometry')
from Autodesk.DesignScript.Geometry import *

# The inputs to this node will be stored as a list in the IN variables.
dataEnteringNode = IN

# Place your code below this line
result = [i for i in IN if i]
# Assign your output to the OUT variable.
OUT = result
# ----------------------------------------
funcSets_2 = Python(IN[1]=철골물량산출함수_Heavy, IN[2]=철골물량산출함수_Medium, IN[3]=철골물량산출함수_Light)  # CPython3; unwired: IN[0]; same code as funcSets
funcSets_3 = Python()  # CPython3; unwired: IN[0], IN[1], IN[2], IN[3]; same code as funcSets
funcSets_4 = Python()  # CPython3; unwired: IN[0], IN[1], IN[2], IN[3], IN[4]; same code as funcSets
final_funcsets_arrange = Python(IN[0]=funcSets, IN[1]=funcSets_2, IN[2]=funcSets_3, IN[3]=funcSets_4)  # CPython3; unwired: IN[4]
# ---------- final_funcsets_arrange.python (15 lines) ----------
# Load the Python Standard and DesignScript Libraries
import sys
import clr
clr.AddReference('ProtoGeometry')
from Autodesk.DesignScript.Geometry import *

from itertools import chain

# The inputs to this node will be stored as a list in the IN variables.
dataEnteringNode = IN

# Place your code below this line
result = [i for i in IN if i]
# Assign your output to the OUT variable.
OUT = list(chain(*result))
# ----------------------------------------

getTargetAndValue = Python(IN[0]=createElemDS, IN[1]=final_funcsets_arrange)  # CPython3
# ---------- getTargetAndValue.python (83 lines) ----------
# Load the Python Standard and DesignScript Libraries
import sys
import clr
clr.AddReference('ProtoGeometry')
from Autodesk.DesignScript.Geometry import *

from itertools import chain

# The inputs to this node will be stored as a list in the IN variables.
dataEnteringNode = IN
elemDSs = IN[0]
funcSets = IN[1]
#func = IN[1][0]
#funcfamilyTag = IN[1][1]
#funcWmTag = IN[1][2]
#funcUnitTag = IN[1][3]
# Place your code below this line


def getTarget(elemDS, funcSets):
    elem = elemDS["elem"]
    etype = elemDS["elemType"]
    familyCode = elemDS["familyCode"]
    wms = elemDS["WMperElem"]
    result = []
    
#    def matchWM_func(wms, funcSet):
#        result = []
#        func = funcSet[0]
#        for wm in wms:
#            tmp1 = []
#            tmp2 = []
#            wmbln = []
#            for i in funcSet[1]:
#                if i in etype:#element type 비교
#                    tmp1.append(True)
#                else:
#                    tmp1.append(False)
#            for i in funcSet[2]:#work type 비교
#                if i in wm:
#                    tmp2.append(True)
#                else:
#                    tmp2.append(False)
#            if any(tmp1) and any(tmp2):
#                result.append([etype, wm, func, func(elem)])
#
#        return result
    
    def matchWM_func(wm, funcSets):
        result = []
        
        for funcSet in funcSets:
            func = funcSet[0]
            tmp1 = []
            tmp2 = []

            for i in funcSet[1]:
                if i in etype:#element type 비교
                    tmp1.append(True)
                else:
                    tmp1.append(False)
            for i in funcSet[2]:#work type 비교
                if i in wm:
                    tmp2.append(True)
                else:
                    tmp2.append(False)
            if any(tmp1) and any(tmp2):
                result.append([etype, wm, func, func(elem)])

        return result

#    result = [matchWM_func(wm, funcSets) for wm in wms]
    result = []
    for wm in wms:
        if matchWM_func(wm, funcSets):
            result.append(matchWM_func(wm, funcSets))
        else:
            result.append([[etype, wm, "-----!!funcSets내, 해당 부재와 해당 공정"+f'({wm.split(": ")[0]})'+"에 대응하는 함수 없음!!-----",["!산출타겟 미지정!","!산출결과 없음!","!산출단위 없음!"]]])

    return list(chain(*result))

# Assign your output to the OUT variable.
OUT = [getTarget(elemDS, funcSets) for elemDS in elemDSs]
# ----------------------------------------

# group: 산출타겟 검증(시각화)
code_block_4 = CodeBlock(input=getTargetAndValue) { input; }
공종목록 = Python(IN[0]=code_block_4)  # CPython3
# ---------- 공종목록.python (34 lines) ----------
# Load the Python Standard and DesignScript Libraries
import sys
import clr
clr.AddReference('ProtoGeometry')
from Autodesk.DesignScript.Geometry import *

clr.AddReference('RevitNodes')
import Revit
clr.ImportExtensions(Revit.Elements)

from DSCore import Color
clr.AddReference('GeometryColor')
from Modifiers import GeometryColor

import random

# The inputs to this node will be stored as a list in the IN variables.
dataEnteringNode = IN
산출결과세트리스트 = IN[0]

def 공종종류(산출결과세트리스트):
    result = []
    for 산출결과세트 in 산출결과세트리스트:
        for i in 산출결과세트:
            공종 = i[1]
            if not 공종 in result:
                result.append(공종)
    return result
    
공종목록 = 공종종류(산출결과세트리스트)

result = 공종목록
# Assign your output to the OUT variable.
OUT = result
# ----------------------------------------
watch = Watch(공종목록)
integer_slider = IntegerSlider(6, range=0..18 step 1)
findWM = Python(IN[0]=watch, IN[1]=integer_slider)  # CPython3
# ---------- findWM.python (31 lines) ----------
# Load the Python Standard and DesignScript Libraries
import sys
import clr
clr.AddReference('ProtoGeometry')
from Autodesk.DesignScript.Geometry import *

# The inputs to this node will be stored as a list in the IN variables.
dataEnteringNode = IN

WMs = IN[0]
idxs = IN[1]
# Place your code below this line

def findWM(WMs,idxs):
    result = []
    if isinstance(idxs, list):
        for idx in idxs:
            if idx > len(WMs):
                result.append(WMs[-1])
            else:
                result.append(WMs[idx])
    else:
        idx = idxs
        if idx > len(WMs):
            result.append(WMs[-1])
        else:
            result.append(WMs[idx])
    return result[0]

# Assign your output to the OUT variable.
OUT = findWM(WMs,idxs)
# ----------------------------------------
code_block_5 = CodeBlock(i=findWM) { String.Split(i, ": ")[1]; }
watch_2 = Watch(code_block_5)
선으로_보기 = BoolSelector(false)
color_palette = ColorPalette({R: 0, G: 0, B: 0, A: 106})
산출타겟_검증 = Python(IN[0]=선으로_보기, IN[1]=color_palette, IN[2]=code_block_4, IN[3]=findWM)  # CPython3
# ---------- 산출타겟_검증.python (126 lines) ----------
# Load the Python Standard and DesignScript Libraries
import sys
import clr
clr.AddReference('ProtoGeometry')
from Autodesk.DesignScript.Geometry import *

clr.AddReference('RevitNodes')
import Revit
clr.ImportExtensions(Revit.Elements)

from DSCore import Color
clr.AddReference('GeometryColor')
from Modifiers import GeometryColor

import random
from itertools import chain

# The inputs to this node will be stored as a list in the IN variables.
dataEnteringNode = IN
선보기여부 = IN[0]
지정색상 = IN[1]
산출결과세트리스트 = IN[2]
공종코드 = IN[3].split(': ')[0]

def listFlatten(inlist):
    result = []
    for i in inlist:
        if isinstance(i, list):
            result += (listFlatten(i))
        else:
            result.append(i)
    return result

def 공종종류(산출결과세트리스트):
    result = []
    for 산출결과세트 in 산출결과세트리스트:
        for i in 산출결과세트:
            공종 = i[1].split(': ')[0]
            if not 공종 in result:
                result.append(공종)
    return result
    
공종목록 = 공종종류(산출결과세트리스트)

def 색상준비(공종목록):
    log = []
    result = {}
    for i in range(len(공종목록)):
        난수1 = random.randint(0,255)
        난수2 = random.randint(0,255)
        난수3 = random.randint(0,255)
        난수4 = random.randint(0,255)
        색상 = Color.ByARGB(난수1,난수2,난수3,난수4)
        if not 색상 in log:
            log.append(색상)
            result[공종목록[i]] = 색상
    return result
    
색상들 = 색상준비(공종목록)
# Place your code below this line
def 시각화(산출결과세트, 색상들, 공종코드):
    result = []
    for 공종결과 in 산출결과세트:
        tmp1 = []
        target = 공종결과[3][0]
        공종 = 공종결과[1].split(': ')[0]
        색상 = 지정색상
        if 공종 == 공종코드:
            if isinstance(target, Revit.Elements.FamilyInstance):
                visual = GeometryColor.ByGeometryColor(target.Geometry()[0], 색상)[0]
                tmp1.append(visual)
            elif isinstance(target, str):
                pass
            else:
                if not isinstance(target, list):
                    visual = GeometryColor.ByGeometryColor(target, 색상)
                    tmp1.append(visual)
                else:
                    for i in target:
                        tmp1.append(GeometryColor.ByGeometryColor(i, 색상))
            result.append(tmp1)
        else:
            pass
    return result

def 시각화_선보기(산출결과세트, 공종코드):
    result = []
    for 공종결과 in 산출결과세트:
        tmp1 = []
        target = 공종결과[3][0]
        공종 = 공종결과[1].split(': ')[0]
        색상 = 지정색상
        if 공종 == 공종코드:
            if isinstance(target, Revit.Elements.FamilyInstance):
                mass = target.Geometry()[0].Explode()
                lines = list(chain(*listFlatten([i.PerimeterCurves() for i in mass])))
                visual = [GeometryColor.ByGeometryColor(i, 색상) for i in lines]
                tmp1.append(visual)
            elif isinstance(target, str):
                pass
            else:
                if not isinstance(target, list):
                    mass = target.Explode()
                    lines = list(chain(*listFlatten([i.PerimeterCurves() for i in mass])))
                    visual = [GeometryColor.ByGeometryColor(i, 색상) for i in lines]
                    tmp1.append(visual)
                else:
                    for i in target:
                        mass = i.Explode()
                        lines = list(chain(*listFlatten([i.PerimeterCurves() for i in mass])))
                        visual = [GeometryColor.ByGeometryColor(i, 색상) for i in lines]
                        tmp1.append(visual)

            result.append(tmp1)
        else:
            pass
    return result



if 선보기여부:
    result = [시각화_선보기(산출결과세트, 공종코드) for 산출결과세트 in 산출결과세트리스트]
else:
    result = [시각화(산출결과세트, 색상들, 공종코드) for 산출결과세트 in 산출결과세트리스트]
# Assign your output to the OUT variable.
OUT = [list(chain(*result))]
# ----------------------------------------

# group: 산출타겟 검증(시각화)
code_block_6 = CodeBlock(input=getTargetAndValue) { input; }
공종목록_2 = Python(IN[0]=code_block_6)  # CPython3; same code as 공종목록
watch_3 = Watch(공종목록_2)
integer_slider_2 = IntegerSlider(9, range=0..18 step 1)
findWM_2 = Python(IN[0]=watch_3, IN[1]=integer_slider_2)  # CPython3; same code as findWM
code_block_7 = CodeBlock(i=findWM_2) { String.Split(i, ": ")[1]; }
watch_4 = Watch(code_block_7)
선으로_보기_2 = BoolSelector(false)
color_palette_2 = ColorPalette({R: 255, G: 0, B: 255, A: 41})
산출타겟_검증_2 = Python(IN[0]=선으로_보기_2, IN[1]=color_palette_2, IN[2]=code_block_6, IN[3]=findWM_2)  # CPython3; same code as 산출타겟_검증

# group: 공종목록 확인
공종목록_3 = Python(IN[0]=getTargetAndValue)  # CPython3; same code as 공종목록
watch_5 = Watch(공종목록_3)

# group: 산출타겟 검증(시각화)
code_block_8 = CodeBlock(input=getTargetAndValue) { input; }
공종목록_4 = Python(IN[0]=code_block_8)  # CPython3; same code as 공종목록
watch_6 = Watch(공종목록_4)
integer_slider_3 = IntegerSlider(10, range=0..18 step 1)
findWM_3 = Python(IN[0]=watch_6, IN[1]=integer_slider_3)  # CPython3; same code as findWM
code_block_9 = CodeBlock(i=findWM_3) { String.Split(i, ": ")[1]; }
watch_7 = Watch(code_block_9)
선으로_보기_3 = BoolSelector(false)
color_palette_3 = ColorPalette({R: 51, G: 127, B: 80, A: 130})
산출타겟_검증_3 = Python(IN[0]=선으로_보기_3, IN[1]=color_palette_3, IN[2]=code_block_8, IN[3]=findWM_3)  # CPython3; same code as 산출타겟_검증

# group: 산출타겟 검증(시각화)
code_block_10 = CodeBlock(input=getTargetAndValue) { input; }
공종목록_5 = Python(IN[0]=code_block_10)  # CPython3; same code as 공종목록
watch_8 = Watch(공종목록_5)
integer_slider_4 = IntegerSlider(18, range=0..18 step 1)
findWM_4 = Python(IN[0]=watch_8, IN[1]=integer_slider_4)  # CPython3; same code as findWM
code_block_11 = CodeBlock(i=findWM_4) { String.Split(i, ": ")[1]; }
watch_9 = Watch(code_block_11)
선으로_보기_4 = BoolSelector(false)
color_palette_4 = ColorPalette({R: 210, G: 105, B: 30, A: 141})
산출타겟_검증_4 = Python(IN[0]=선으로_보기_4, IN[1]=color_palette_4, IN[2]=code_block_10, IN[3]=findWM_4)  # CPython3; same code as 산출타겟_검증

# group: 단위부재 테스트 용도
code_block_12 = CodeBlock(i=code_block._InputElement) { i; }

name = Element.Name(element=code_block_12)
code_block_13 = CodeBlock(i=all_elements_of_category) { i.Name; }
code_block_14 = CodeBlock(i=code_block_12) { i[9]; }

# group: 산출타겟 검증(시각화)
선으로_보기_5 = BoolSelector(false)
color_palette_5 = ColorPalette({R: 30, G: 144, B: 255, A: 129})
code_block_15 = CodeBlock(input=getTargetAndValue) { input; }
공종목록_6 = Python(IN[0]=code_block_15)  # CPython3; same code as 공종목록
watch_10 = Watch(공종목록_6)
integer_slider_5 = IntegerSlider(1, range=0..18 step 1)
findWM_5 = Python(IN[0]=watch_10, IN[1]=integer_slider_5)  # CPython3; same code as findWM
산출타겟_검증_5 = Python(IN[0]=선으로_보기_5, IN[1]=color_palette_5, IN[2]=code_block_15, IN[3]=findWM_5)  # CPython3; same code as 산출타겟_검증
code_block_16 = CodeBlock(i=findWM_5) { String.Split(i, ": ")[1]; }
watch_11 = Watch(code_block_16)

# group: 공종별 상세조회
listSets = Python(IN[1]=산출타겟_검증_2, IN[2]=산출타겟_검증_3, IN[3]=산출타겟_검증_4, IN[4]=산출타겟_검증_5)  # CPython3; unwired: IN[0], IN[5], IN[6], IN[7]; same code as funcSets
watch_3d = Watch3D(listSets)

# group: 터파기산출함수
familytype_tag_9 = CodeBlock()
# ---------- familytype_tag_9.designscript (3 lines) ----------
[
"Footing-Rectangular"
];
# ----------------------------------------
wbs_tag_9 = CodeBlock()
# ---------- wbs_tag_9.designscript (3 lines) ----------
[
"A01ZZ001"
];
# ----------------------------------------
# note: refFunc = IN[0]
# tag = IN[1]
# input = IN[2]
tag_전달_및_함수인풋값_전달_9 = CodeBlock(i=familytype_tag_9, j=wbs_tag_9, r=tag_전달_및_함수인풋값_전달_3.r) { List.Join([[i],[j]]); test; r; r["온통터파기_여부"]; r["터파기_하부Offset"]; r["버림thk"]; r["경사비율_IsoFDN"]; }  # unwired: test
터파기산출함수 = Python(IN[1]=tag_전달_및_함수인풋값_전달_9.out0, IN[2]=tag_전달_및_함수인풋값_전달_9.test, IN[3]=tag_전달_및_함수인풋값_전달_9.out3, IN[4]=tag_전달_및_함수인풋값_전달_9.out4, IN[5]=tag_전달_및_함수인풋값_전달_9.out5, IN[6]=tag_전달_및_함수인풋값_전달_9.out6)  # CPython3; unwired: IN[0]
# ---------- 터파기산출함수.python (112 lines) ----------
# Load the Python Standard and DesignScript Libraries
import sys
import clr

clr.AddReference('RevitAPI')
from Autodesk.Revit.DB import *
import Autodesk

clr.AddReference('RevitNodes')
import Revit
clr.ImportExtensions(Revit.Elements)

clr.AddReference('RevitServices')
import RevitServices
from RevitServices.Persistence import DocumentManager
doc = DocumentManager.Instance.CurrentDBDocument
collector1 = FilteredElementCollector(doc)#Autodesk.Revit.DB.FilteredElementCollector(doc)

clr.AddReference('ProtoGeometry')
from Autodesk.DesignScript.Geometry import *

allFdns = collector1.OfCategory(BuiltInCategory.OST_StructuralFoundation).WhereElementIsNotElementType().ToElements()
allIsoFdns = [i.ToDSType(False) for i in allFdns if "Footing-" in i.Name]

# The inputs to this node will be stored as a list in the IN variables.
dataEnteringNode = IN

refFunc = IN[0]
tag = IN[1]
input = IN[2]

wholeExcavationBln = IN[3]
bttmOffset = IN[4]
버림thk = IN[5]
slopeExcav = IN[6]

# Place your code below this line

def 터파기산출함수(input):
    targets = []
    
    if wholeExcavationBln:
        calcTargetNum = len(allIsoFdns)
        fdnsGeo = [i.Geometry()[0] for i in allIsoFdns]
        bdBox_fdn = BoundingBox.ByGeometry(fdnsGeo).ToCuboid()
        srfs = bdBox_fdn.Explode()
        belowSrf = [i for i in srfs if i.NormalAtParameter(0.5,0.5).Z == -1][0]
        def getSrfHeight(srf):
            _crvs = srf.PerimeterCurves()
            heights = [i.StartPoint.Z for i in _crvs]
            height = min(heights)
            return height
        belowSrf_height = getSrfHeight(belowSrf)
        
        def findLeanThk(leanobj):
            if leanobj:
                return leanobj.GetParameterValueByName("thk")
            else:
                return 버림thk
        leanobj = None
        leanthk = findLeanThk(leanobj)
        
        def offsetCrv(crv, offset=300):
            return crv.Offset(offset)
        def correctElev(crv, thk):
            return crv.Translate(0,0,thk)
        _exca_belowbdry = offsetCrv(PolyCurve.ByJoinedCurves(belowSrf.PerimeterCurves()), bttmOffset)
        exca_belowbdry = correctElev(_exca_belowbdry, -버림thk)
        _exca_upperbdry = correctElev(_exca_belowbdry, -belowSrf_height)
        exca_upperbdry = offsetCrv(_exca_upperbdry, -belowSrf_height/slopeExcav)
        target = Solid.ByLoft([exca_belowbdry,exca_upperbdry])
        targetGeo = target
        targetValue = sum([i.Volume for i in [target]])/calcTargetNum/1000000000
        
        
    else:
        calcTargetNum = 1
        srfs = input.Geometry()[0].Explode()
        belowSrf = [i for i in srfs if i.NormalAtParameter(0.5,0.5).Z == -1][0]
        
        def getSrfHeight(srf):
            _crvs = srf.PerimeterCurves()
            heights = [i.StartPoint.Z for i in _crvs]
            height = min(heights)
            return height
        belowSrf_height = getSrfHeight(belowSrf)
        
        def findLeanThk(leanobj):
            if leanobj:
                return leanobj.GetParameterValueByName("thk")
            else:
                return 버림thk
        leanobj = None
        leanthk = findLeanThk(leanobj)
        
        def offsetCrv(crv, offset=300):
            return crv.Offset(offset)
        def correctElev(crv, thk):
            return crv.Translate(0,0,thk)
        _exca_belowbdry = offsetCrv(PolyCurve.ByJoinedCurves(belowSrf.PerimeterCurves()), bttmOffset)
        exca_belowbdry = correctElev(_exca_belowbdry, -버림thk)
        _exca_upperbdry = correctElev(_exca_belowbdry, -belowSrf_height)
        exca_upperbdry = offsetCrv(_exca_upperbdry, -belowSrf_height/slopeExcav)
        target = Solid.ByLoft([exca_belowbdry,exca_upperbdry])
        targetGeo = target
        targetValue = sum([i.Volume for i in [target]])/calcTargetNum/1000000000

    return (targetGeo, targetValue, "M3")

# Assign your output to the OUT variable.
#OUT = fdnsGeo
OUT = (터파기산출함수,tag[0],tag[1],["M3"])
# ----------------------------------------

# group: 잔토처리산출함수
familytype_tag_10 = CodeBlock()  # same code as familytype_tag_9
wbs_tag_10 = CodeBlock()
# ---------- wbs_tag_10.designscript (3 lines) ----------
[
"A01ZZ004"
];
# ----------------------------------------
# note: refFunc = IN[0]
# tag = IN[1]
# input = IN[2]
tag_전달_및_함수인풋값_전달_10 = CodeBlock(i=familytype_tag_10, j=wbs_tag_10, r=tag_전달_및_함수인풋값_전달_5.r) { List.Join([[i],[j]]); test; r; r["온통터파기_여부"]; r["토량_환산계수"]; }  # unwired: test
잔토처리산출함수 = Python(IN[0]=터파기산출함수, IN[1]=tag_전달_및_함수인풋값_전달_10.out0, IN[2]=tag_전달_및_함수인풋값_전달_10.test, IN[3]=tag_전달_및_함수인풋값_전달_10.out3, IN[4]=tag_전달_및_함수인풋값_전달_10.out4)  # CPython3
# ---------- 잔토처리산출함수.python (67 lines) ----------
# Load the Python Standard and DesignScript Libraries
import sys
import clr

clr.AddReference('RevitAPI')
from Autodesk.Revit.DB import *
import Autodesk

clr.AddReference('RevitNodes')
import Revit
clr.ImportExtensions(Revit.Elements)

clr.AddReference('RevitServices')
import RevitServices
from RevitServices.Persistence import DocumentManager
doc = DocumentManager.Instance.CurrentDBDocument
collector1 = FilteredElementCollector(doc)
collector2 = FilteredElementCollector(doc)
collector3 = FilteredElementCollector(doc)
collector4 = FilteredElementCollector(doc)

clr.AddReference('ProtoGeometry')
from Autodesk.DesignScript.Geometry import *

from itertools import chain

allFdns = collector1.OfCategory(BuiltInCategory.OST_StructuralFoundation).WhereElementIsNotElementType().ToElements()
allCols = collector2.OfCategory(BuiltInCategory.OST_StructuralColumns).WhereElementIsNotElementType().ToElements()
allBeams = collector3.OfCategory(BuiltInCategory.OST_StructuralFraming).WhereElementIsNotElementType().ToElements()
allFloors = collector4.OfCategory(BuiltInCategory.OST_Floors).WhereElementIsNotElementType().ToElements()
allIsoFdns = [i.ToDSType(False) for i in allFdns if "Footing-" in i.Name]
allPeds = [i.ToDSType(False) for i in allCols if "UG" in i.Name]
allPedsGeo = [i.Geometry()[0] for i in allPeds]
allTGs = [i.ToDSType(False) for i in allBeams if "TG" in i.Name]
allTGsGeo = [i.Geometry()[0] for i in allTGs]
allSOGs = [i.ToDSType(False) for i in allFdns if "SOG" in i.Name and "GS" in i.Name]
allSOGsGeo = [i.Geometry()[0] for i in allSOGs]

# The inputs to this node will be stored as a list in the IN variables.
dataEnteringNode = IN

refFunc = IN[0]
tag = IN[1]
input = IN[2]

wholeExcavationBln = IN[3]
ratio = IN[4]


# Place your code below this line

def 잔토처리산출함수(input):
        
    calcTargetNum = 1
    터파기산출함수 = refFunc[0]
    exca_solid = 터파기산출함수(input)[0]
    fdn_solid = input.Geometry()[0]

    target = fdn_solid.Intersect(exca_solid)[0]
    targetGeo = target
    targetValue = sum([i.Volume for i in [target]])*ratio/calcTargetNum/1000000000

    return (targetGeo, targetValue, "M3")

# Assign your output to the OUT variable.
#OUT = getBackfillTarget(input)
OUT = (잔토처리산출함수,tag[0],tag[1],["M3"])
# ----------------------------------------

# group: 되메우기산출함수
familytype_tag_11 = CodeBlock()  # same code as familytype_tag_9
wbs_tag_11 = CodeBlock()
# ---------- wbs_tag_11.designscript (3 lines) ----------
[
"A01ZZ003"
];
# ----------------------------------------
# note: refFunc = IN[0]
# tag = IN[1]
# input = IN[2]
tag_전달_및_함수인풋값_전달_11 = CodeBlock(i=familytype_tag_11, j=wbs_tag_11, r=tag_전달_및_함수인풋값_전달_4.r) { List.Join([[i],[j]]); test; r; r["온통터파기_여부"]; }  # unwired: test
되메우기산출함수 = Python(IN[0]=터파기산출함수, IN[1]=tag_전달_및_함수인풋값_전달_11.out0, IN[2]=tag_전달_및_함수인풋값_전달_11.test, IN[3]=tag_전달_및_함수인풋값_전달_11.out3)  # CPython3
# ---------- 되메우기산출함수.python (83 lines) ----------
# Load the Python Standard and DesignScript Libraries
import sys
import clr

clr.AddReference('RevitAPI')
from Autodesk.Revit.DB import *
import Autodesk

clr.AddReference('RevitNodes')
import Revit
clr.ImportExtensions(Revit.Elements)

clr.AddReference('RevitServices')
import RevitServices
from RevitServices.Persistence import DocumentManager
doc = DocumentManager.Instance.CurrentDBDocument
collector1 = FilteredElementCollector(doc)
collector2 = FilteredElementCollector(doc)
collector3 = FilteredElementCollector(doc)
collector4 = FilteredElementCollector(doc)

clr.AddReference('ProtoGeometry')
from Autodesk.DesignScript.Geometry import *

from itertools import chain

allFdns = collector1.OfCategory(BuiltInCategory.OST_StructuralFoundation).WhereElementIsNotElementType().ToElements()
allCols = collector2.OfCategory(BuiltInCategory.OST_StructuralColumns).WhereElementIsNotElementType().ToElements()
allBeams = collector3.OfCategory(BuiltInCategory.OST_StructuralFraming).WhereElementIsNotElementType().ToElements()
allFloors = collector4.OfCategory(BuiltInCategory.OST_Floors).WhereElementIsNotElementType().ToElements()
allIsoFdns = [i.ToDSType(False) for i in allFdns if "Footing-" in i.Name]
allPeds = [i.ToDSType(False) for i in allCols if "UG" in i.Name]
allPedsGeo = [i.Geometry()[0] for i in allPeds]
allTGs = [i.ToDSType(False) for i in allBeams if "UG" in i.Name] #[i.ToDSType(False) for i in allBeams if "TG" in i.Name]
allTGsGeo = list(chain(*[i.Geometry() for i in allTGs]))
allSOGs = [i.ToDSType(False) for i in allFdns if "SOG" in i.Name and "GS" in i.Name]
allSOGsGeo = [i.Geometry()[0] for i in allSOGs]

# The inputs to this node will be stored as a list in the IN variables.
dataEnteringNode = IN

refFunc = IN[0]
tag = IN[1]
input = IN[2]
wholeExcavationBln = IN[3]

# Place your code below this line

def 되메우기산출함수(input):
    targets = []
    
    if wholeExcavationBln:
        calcTargetNum = len(allIsoFdns)
        터파기산출함수 = refFunc[0]
        exca_solid = 터파기산출함수(input)[0]
        fdn_solid = list(chain(*[i.Geometry() for i in allIsoFdns]))
        _diff_target = fdn_solid + allPedsGeo + allTGsGeo + allSOGsGeo
        diff_target = Solid.ByUnion(_diff_target)

        target = exca_solid.Difference(diff_target)
        targetGeo = target
        targetValue = sum([i.Volume for i in [target]])/calcTargetNum/1000000000

    else:
        calcTargetNum = 1
        터파기산출함수 = refFunc[0]
        exca_solid = 터파기산출함수(input)[0]
        fdn_solid = input.Geometry()[0]
        _joinedPeds = [i for i in allPedsGeo if i.DoesIntersect(exca_solid)]
        _joinedTGs = [i for i in allTGsGeo if i.DoesIntersect(exca_solid)]
        _joinedSOGs = [i for i in allSOGsGeo if i.DoesIntersect(exca_solid)]
        _diff_target = [fdn_solid] + _joinedPeds + _joinedTGs + _joinedSOGs
        diff_target = Solid.ByUnion(_diff_target)
        
        target = exca_solid.Difference(diff_target)
        targetGeo = target
        targetValue = sum([i.Volume for i in [target]])/calcTargetNum/1000000000

    return (targetGeo, targetValue, "M3")

# Assign your output to the OUT variable.
#OUT = getBackfillTarget(input)
OUT = (되메우기산출함수,tag[0],tag[1],["M3"])
# ----------------------------------------

# group: 부재 항목 별 WM 매칭 검증
watch_12 = Watch(getTargetAndValue)

# group: Excel Export
excel로_export_하시겠습니까 = BoolSelector(false)  # graph input
categories_2 = Categories("OST_ProjectInformation")
all_elements_of_category_2 = ElementsOfCategory(Category=categories_2)
code_block_17 = CodeBlock(i=all_elements_of_category_2)
# ---------- code_block_17.designscript (4 lines) ----------
[
i.GetParameterValueByName("Project Name")[0],
i.GetParameterValueByName("Building Name")[0]
];
# ----------------------------------------
toLower = String.ToLower(string=code_block_17)
toTitle = String.ToTitle(str=toLower)
input = CodeBlock(pjtinfo=toTitle, sheetname=sheet_name)
# ---------- input.designscript (2 lines) ----------
[pjtinfo,
sheetname];
# ----------------------------------------
data_arrange_for_excel = Python(IN[0]=watch_12)  # CPython3
# ---------- data_arrange_for_excel.python (34 lines) ----------
# Load the Python Standard and DesignScript Libraries
import sys
import clr
clr.AddReference('ProtoGeometry')
from Autodesk.DesignScript.Geometry import *

# The inputs to this node will be stored as a list in the IN variables.
dataEnteringNode = IN
lists = IN[0]
# Place your code below this line

def arrangeDataForExcel(lists):
    result = []
    for elem in lists:
        for wm in elem:
            tmp1 = []
            if "-!!" in str(wm[2]) or "!" in str(wm[3][0]):
                pass
            else:
                tmp1 = []
                tmp1.append(wm[0])
                tmp1.append(wm[1].split(': ')[0])
                tmp1.append(wm[1].split(': ')[1])
                tmp1.append(round(wm[3][1],2))
                tmp1.append(wm[3][2])
            if tmp1:
                result.append(tmp1)
            else:
                pass
    return result

result = arrangeDataForExcel(lists)
# Assign your output to the OUT variable.
OUT = result
# ----------------------------------------
python_script_export_excel_by = Python(IN[0]=excel로_export_하시겠습니까, IN[2]=input, IN[3]=data_arrange_for_excel)  # "Python Script@Export Excel(By OpenpyXl)_test"; CPython3; unwired: IN[1]
# ---------- python_script_export_excel_by.python (235 lines) ----------
# Load the Python Standard and DesignScript Libraries
import sys
import os
#sys.path.append(r'C:\Users\HEC\AppData\Local\Programs\Python\Python39\Lib\site-packages')
#sys.path.append(r'C:\Users\pjmk0\AppData\Local\Programs\Python\Python39\Lib\site-packages')
sys.path.append(os.getenv('LOCALAPPDATA').replace('\\','\\\\') + r'\Programs\Python\Python39\Lib\site-packages')
import clr
clr.AddReference('ProtoGeometry')
from Autodesk.DesignScript.Geometry import *
from collections import Iterable

from itertools import chain
def iterable(obj):
    return isinstance(obj, Iterable)


# The inputs to this node will be stored as a list in the IN variables.
dataEnteringNode = IN

exportBln = IN[0]
oldfilepath = IN[1]
pjtinfo = IN[2][0]
PjtName = pjtinfo[0]
BldgName = pjtinfo[1]
SheetName = IN[2][1]
InData = IN[3]

# Place your code below this line
import datetime
from datetime import date, timedelta, datetime
Today = date.today()
now = datetime.now()

import openpyxl
from openpyxl.styles import Border, Side, PatternFill, Font, GradientFill, Alignment, Color, numbers

sample_items = InData

### 기존 워크북 불러오기
#wb = openpyxl.load_workbook(oldfilepath)

def write_to_Newfile(filepath, SheetName):
    def findWMset(InData):
        result = []
        tmp = []
        for i in InData:
            tmp.append(i[1])
        tmp = set(tmp)
        for i in tmp:
            result.append([i])
        return result
    
    WMset = findWMset(sample_items)
    
    wb = openpyxl.Workbook()
    for sheet in wb.sheetnames:
        wb.remove(wb[sheet])

    thin = Side(border_style="thin", color="000000")
    double = Side(border_style="double", color="000000")

    ws_sum = wb.create_sheet(title= "Summary", index=0)
    
    ws = wb.create_sheet(title= f'{SheetName}')
    
##################ws_sum#########
    ws_sum.merge_cells('A1:L1')
    ws_sum['A1'] = f'Summary Sheet ({PjtName}_{BldgName})'
    cell = ws_sum['A1']
    cell.font = openpyxl.styles.Font(color='000000', size=20)
    cell.fill = openpyxl.styles.fills.PatternFill(patternType='solid', fgColor=openpyxl.styles.colors.Color(rgb='fff3b0'))

    ws_sum['A2'] = 'Item Number'
    ws_sum['A2'].font = openpyxl.styles.Font(b=True, color='000000', size=12)
    ws_sum['B2'] = 'WorkMaster Code'
    ws_sum['B2'].font = openpyxl.styles.Font(b=True, color='000000', size=12)
    ws_sum['C2'] = 'Description'
    ws_sum['C2'].font = openpyxl.styles.Font(b=True, color='000000', size=12)
    ws_sum['D2'] = 'Quantities'
    ws_sum['D2'].font = openpyxl.styles.Font(b=True, color='000000', size=12)
    ws_sum['E2'] = 'Unit'
    ws_sum['E2'].font = openpyxl.styles.Font(b=True, color='000000', size=12)
    ws_sum['F2'] = 'Unit Price'
    ws_sum['F2'].font = openpyxl.styles.Font(b=True, color='000000', size=12)
    ws_sum['G2'] = 'Total Price'
    ws_sum['G2'].font = openpyxl.styles.Font(b=True, color='000000', size=12)


## 칼럼별 너비 조정 구간
#    for col in range(ws.max_column):
#        ws.column_dimensions[chr(ord('A') + col)].width = 15
    ws_sum.column_dimensions['A'].width = 5
    ws_sum.column_dimensions['B'].width = 20
    ws_sum.column_dimensions['C'].width = 75
    ws_sum.column_dimensions['D'].width = 11
    ws_sum.column_dimensions['E'].width = 9.5
    ws_sum.column_dimensions['F'].width = 11
    ws_sum.column_dimensions['G'].width = 11


    start_row = 4
    ws_sum.merge_cells(f'A{start_row-1}:G{start_row-1}')
    ws_sum[f'A{start_row-1}'] = f'Summary for_{SheetName}'
    cell = ws_sum[f'A{start_row-1}']
    cell.font = openpyxl.styles.Font(color='000000', size=12.5)
    cell.fill = openpyxl.styles.fills.PatternFill(patternType='solid', fgColor=openpyxl.styles.colors.Color(rgb='aaf2d1'))
    for (row, item) in enumerate(WMset, start_row):
        cell = ws_sum.cell(row=row, column=1, value=row - 3)
        #cell.number_format = openpyxl.styles.numbers.builtin_format_code(0)
        cell.alignment = openpyxl.styles.Alignment(horizontal='center', vertical='center')

        ws_sum.cell(row=row, column=2, value=item[0]) ## WorkMaster Code 칼럼
        
        cell = ws_sum.cell(row=row, column=3, value= f"= VLOOKUP(B{cell.row},'{SheetName}'!$C${start_row}:$F${start_row+len(sample_items)},2,FALSE)".format(current_row=cell.row))
        
        cell = ws_sum.cell(row=row, column=4, value= f"= SUMIF('{SheetName}'!$C${start_row}:$C${start_row+len(sample_items)},B{cell.row},'{SheetName}'!$E${start_row}:$E${start_row+len(sample_items)})".format(current_row=cell.row))
        
        cell = ws_sum.cell(row=row, column=5, value= f"= VLOOKUP(B{cell.row},'{SheetName}'!$C${start_row}:$F${start_row+len(sample_items)},4,FALSE)".format(current_row=cell.row))
        
        
        cell = ws_sum.cell(row=row, column=7, value='= D{current_row}*F{current_row}'.format(current_row=cell.row))
        cell.number_format = '#,##0.00'

    total_row = ws_sum.max_row + 1
    if total_row > start_row:
        cell1 = ws_sum.cell(row=total_row, column=6, value='Total')
        cell1.font = openpyxl.styles.Font(b=True, color='000000', size=15)
        
        cell2 = ws_sum.cell(row=total_row, column=7, value='= SUM(G{}:G{})'.format(start_row, total_row - 1))
        cell2.number_format = openpyxl.styles.numbers.builtin_format_code(3)
        cell2.border = Border(top=double, left=double, right=double, bottom=double)
        cell2.font = openpyxl.styles.Font(b=True, color='ff03ce', size=15)
    
    
    
##################ws#########
    ws.merge_cells('A1:L1')
    ws['A1'] = f'{SheetName} Category Calculation Sheet ({PjtName}_{BldgName})'
    cell = ws['A1']
    cell.font = openpyxl.styles.Font(color='000000', size=20)
    cell.fill = openpyxl.styles.fills.PatternFill(patternType='solid', fgColor=openpyxl.styles.colors.Color(rgb='fff3b0'))

    ws['A2'] = 'Item Number'
    ws['A2'].font = openpyxl.styles.Font(b=True, color='000000', size=12)
    ws['B2'] = 'Family Type'
    ws['B2'].font = openpyxl.styles.Font(b=True, color='000000', size=12)
    ws['C2'] = 'WorkMaster Code'
    ws['C2'].font = openpyxl.styles.Font(b=True, color='000000', size=12)
    ws['D2'] = 'Description'
    ws['D2'].font = openpyxl.styles.Font(b=True, color='000000', size=12)
    ws['E2'] = 'Quantities'
    ws['E2'].font = openpyxl.styles.Font(b=True, color='000000', size=12)
    ws['F2'] = 'Unit'
    ws['F2'].font = openpyxl.styles.Font(b=True, color='000000', size=12)
    ws['G2'] = 'Unit Price'
    ws['G2'].font = openpyxl.styles.Font(b=True, color='000000', size=12)
    ws['H2'] = 'Total Price'
    ws['H2'].font = openpyxl.styles.Font(b=True, color='000000', size=12)


## 칼럼별 너비 조정 구간
#    for col in range(ws.max_column):
#        ws.column_dimensions[chr(ord('A') + col)].width = 15
    ws.column_dimensions['A'].width = 15
    ws.column_dimensions['B'].width = 45
    ws.column_dimensions['C'].width = 25
    ws.column_dimensions['D'].width = 60
    ws.column_dimensions['E'].width = 15
    ws.column_dimensions['F'].width = 20
    ws.column_dimensions['G'].width = 20
    ws.column_dimensions['H'].width = 20



    start_row = 3
    for (row, item) in enumerate(sample_items, start_row):
        cell = ws.cell(row=row, column=1, value=row - 2)
        #cell.number_format = openpyxl.styles.numbers.builtin_format_code(0)
        cell.alignment = openpyxl.styles.Alignment(horizontal='center', vertical='center')

#        cell = ws.cell(row=row, column=2, value=item[0])
#        cell.number_format = openpyxl.styles.numbers.FORMAT_DATE_YYYYMMDD2  # 'yyyy-mm-dd'
        ws.cell(row=row, column=2, value=item[0]) ## Family Type 칼럼

        ws.cell(row=row, column=3, value=item[1]) ## WorkMaster Code 칼럼
        
        ws.cell(row=row, column=4, value=item[2]) ## WorkMaster Code 칼럼
        
        ws.cell(row=row, column=5, value=item[3]) ## Quantities 칼럼
        cell.number_format = '#,##0.00'
        
        ws.cell(row=row, column=6, value=item[4]) ## Unit 칼럼
        

        cell = ws.cell(row=row, column=8, value='= E{current_row}*G{current_row}'.format(current_row=cell.row))
        cell.number_format = '#,##0.00'

    total_row = ws.max_row + 1
    if total_row > start_row:
        cell1 = ws.cell(row=total_row, column=7, value='Total')
        cell1.font = openpyxl.styles.Font(b=True, color='000000', size=15)
        
        cell2 = ws.cell(row=total_row, column=8, value='= SUM(H{}:H{})'.format(start_row, total_row - 1))
        cell2.number_format = openpyxl.styles.numbers.builtin_format_code(3)
        cell2.border = Border(top=double, left=double, right=double, bottom=double)
        cell2.font = openpyxl.styles.Font(b=True, color='ff03ce', size=15)


    wb.save(filepath)
    wb.close()


##if __name__ == '__main__':
#write_to_file('C:\\Users\\pjmk0\\AppData\\Roaming\\test.xlsx')
if exportBln:
    if not oldfilepath:
        save_name = f'{SheetName} CalcSheet ({PjtName}_{BldgName})_' + now.strftime("%Y-%m-%d_%H%M%S") + '.xlsx'
        path = os.getenv('APPDATA').replace('\\','\\\\')
        filePath = path + '\\' + save_name
        
        write_to_Newfile(filePath, SheetName)
    else:
#        #write_to_Oldfile(filePath)
#        wb = openpyxl.load_workbook(oldfilepath)
#        ws_sum = wb['Summary']
#        
#        ws_sum.append(range(10))
#        wb.save(oldfilepath)
#        wb.close()
        pass
else:
    pass

# Assign your output to the OUT variable.
OUT = os.getenv('APPDATA')
# ----------------------------------------
