# Dynamo graph 04_Str Foundation_r0(220118).dyn (Dynamo 2.12.0.5650)

# note: 되메우기기

# group: 산출함수 작성 및 취합 구간

# group: Primary Input : Excel & Revit Elements
categories = Categories("OST_StructuralFoundation")
all_elements_of_category = ElementsOfCategory(Category=categories)
string_from_web = Python()  # CPython3; unwired: IN[0]
# ---------- string_from_web.python (19 lines) ----------
# Load the Python Standard and DesignScript Libraries
import sys
import clr
clr.AddReference('ProtoGeometry')
from Autodesk.DesignScript.Geometry import *
import urllib.request

# The inputs to this node will be stored as a list in the IN variables.
dataEnteringNode = IN
inputURL = "https://raw.githubusercontent.com/HNANmal/mQ/master/Hdynlib/General/ImportExcel.py"

# Place your code below this line
req = urllib.request
data = req.urlopen(inputURL)

result = data.read().decode("utf-8")

# Assign your output to the OUT variable.
OUT = result
# ----------------------------------------
file_path = Filename("..\DMS(Data Matching Schedule)_R0(Seq2)_STB,CCB(우성전달용)_2022_0111.xlsx")  # graph input
sheet_name = CodeBlock { "Str Foundations"; }
github_python_import_excel_by = PythonStringNode(script=string_from_web, IN[0]=file_path, IN[1]=sheet_name)  # "Github_Python@Import Excel(By OpenpyXl)"; CPython3
code_block = CodeBlock(InputElement=all_elements_of_category, InputData=github_python_import_excel_by) { _InputElement; _InputData; }

# group: GetFull WMCodeDescription PerElement
excelDataManagerNode = Python(IN[0]=code_block._InputElement, IN[1]=code_block._InputData)  # CPython3
# ---------- excelDataManagerNode.python (279 lines) ----------
# Load the Python Standard and DesignScript Libraries
import os
import sys
sys.path.append(os.getenv('LOCALAPPDATA').replace('\\','\\\\') + r'\Programs\Python\Python39\Lib\site-packages')
import clr
clr.AddReference('RevitAPI')
import Autodesk

clr.AddReference('ProtoGeometry')
from Autodesk.DesignScript.Geometry import *

clr.AddReference('RevitNodes')
import Revit
clr.ImportExtensions(Revit.Elements)

clr.ImportExtensions(Revit.GeometryConversion)
clr.ImportExtensions(Revit.GeometryReferences)

clr.AddReference('RevitServices')
import RevitServices
from RevitServices.Persistence import DocumentManager
from RevitServices.Transactions import TransactionManager

doc = DocumentManager.Instance.CurrentDBDocument

import random
import itertools
from functools import reduce
from collections import Iterable
import datetime
import openpyxl

def iterable(obj):
    return isinstance(obj, Iterable)

def findUnique(inputs):
    result = []
    for i in inputs:
        if i in result:
            pass
        else:
            result.append(i)
    return result

# The inputs to this node will be stored as a list in the IN variables.
dataEnteringNode = IN
inputElements = IN[0]
inputData = IN[1]
#inputSheetName = IN[2]

def importExcel(path, SheetNameIn):
    wb_obj = openpyxl.load_workbook(str(path), data_only=True)
    sheet_obj = wb_obj.get_sheet_by_name(str(SheetNameIn))

    m_row = sheet_obj.max_row
    m_col = sheet_obj.max_column

    listOut = []

    for i in range(1, m_row +1):
        listTemp = []
        for j in range(1, m_col + 1):
            cell_obj = sheet_obj.cell(row=i, column=j)
            listTemp.append(cell_obj.value)
            if len(listTemp) == m_col:
                listOut.append(listTemp)
    return listOut

def getUsedFamilyTypeOfModeling(elements):
    familyCode = list(map(lambda x: x.Name.split('_')[0], elements))
    unq_familyCode = findUnique(familyCode)
    return unq_familyCode
    
def createExcelDataDictionary(values):
    result = {}
    for i in range(len(values)):
        result[str(i)] = values[i]
    return result

def findTargetIndex(targets, list):
    result = []
    for target in targets:
        for i in range(len(list)):
            if target in str(list[i]):
                result.append(i)
            else:
                pass
    result.sort()
    return result
    
def GetValueAtKeys(keys, dictionary):
    result = [] 
    for i in keys:
        result.append(dictionary[str(i)])
    return result


# Place your code below this line
usedFamilyTypeOfModeling = getUsedFamilyTypeOfModeling(inputElements)
excelWholeDataSet = inputData#importExcel(inputFilePath, inputSheetName)
trExcelWholeDataSet = list(zip(*excelWholeDataSet))
excelColumnDataSet = createExcelDataDictionary(trExcelWholeDataSet)
excelRowDataSet = createExcelDataDictionary(excelWholeDataSet)
ColumnIndexOfUsedFamilyType = findTargetIndex(usedFamilyTypeOfModeling, trExcelWholeDataSet)
ColDataSetOfUsedFamilyType = GetValueAtKeys(ColumnIndexOfUsedFamilyType, excelColumnDataSet)
materialPerElementFromModeling = []
for i in inputElements:
    materialPerElementFromModeling.append(i.GetMaterials())
#list(map(lambda x: x.GetMaterials, inputElements)) "맵함수로 처리하면 리스트화 할 때 타입 변환 오류 남"

targetWMRowIndex = []
for i in ColDataSetOfUsedFamilyType:
    targetWMRowIndex.append(findTargetIndex(['000'], i))

rowDataSetOfUsedWM = []
for i in targetWMRowIndex:
    rowDataSetOfUsedWM.append(GetValueAtKeys(i, excelRowDataSet))

workGroup = []
for i in rowDataSetOfUsedWM:
    tmp = []
    for j in i:
        tmp.append(j[0])
    workGroup.append(tmp)
    
workMaster = []
for i in range(len(ColDataSetOfUsedFamilyType)):
    tmp=[]
    for k in targetWMRowIndex[i]:
        tmp.append(ColDataSetOfUsedFamilyType[i][k])
    workMaster.append(tmp)

matchedWM = []
for i in range(len(workGroup)):
    tmp = []
    for j in range(len(workGroup[i])):
        fullWM = workGroup[i][j] +"-"+ workMaster[i][j]
        tmp.append(fullWM)
    matchedWM.append(tmp)

matchedWorkGruopAndMasterCode = []
for i in matchedWM:
    if len(i) > 0:
        matchedWorkGruopAndMasterCode.append(i)
    else:
        pass

matchedWMDescription = []
for i in rowDataSetOfUsedWM:
    tmp=[]
    for j in i:
        tmp.append(j[1] +" "+ j[2] +" "+ j[3] +" "+ "("+ j[4] +")")
    if len(tmp) > 0:
        matchedWMDescription.append(tmp)
    else:
        pass

matchedWMUnit = []
for i in rowDataSetOfUsedWM:
    tmp=[]
    for j in i:
        tmp.append(j[4])
    if len(tmp) > 0:
        matchedWMUnit.append(tmp)
    else:
        pass

matchedWorkGruopAndMasterCode_flat = list(itertools.chain(*matchedWorkGruopAndMasterCode))
matchedWMDescription_flat = list(itertools.chain(*matchedWMDescription))

dic_WMandDescription_Excel = {}
for i in range(len(matchedWorkGruopAndMasterCode_flat)):
    dic_WMandDescription_Excel[matchedWorkGruopAndMasterCode_flat[i]] = matchedWMDescription_flat[i]

usedFamilyTypeInExcelOrder = list(map(lambda x: x[3], ColDataSetOfUsedFamilyType))
usedFamilyCodeInExcelOrder = findUnique(list(map(lambda x: x.split('_')[0], usedFamilyTypeInExcelOrder)))

dic_FamilyCodeandWM = {}
for i in range(len(usedFamilyCodeInExcelOrder)):
    dic_FamilyCodeandWM[usedFamilyCodeInExcelOrder[i]] = matchedWorkGruopAndMasterCode[i]

workMasterCodePerElement = []
familyCodePerElem = list(map(lambda x: x.Name.split('_')[0], inputElements))
for i in familyCodePerElem:
    workMasterCodePerElement.append(dic_FamilyCodeandWM[i])

materialNamePerElem = []
for i in materialPerElementFromModeling:
    tmp = []
    for j in i:
        tmp.append(j.Name)
    materialNamePerElem.append(tmp)

WMPerElementFromModeling = []
for i in materialNamePerElem:
    tmp = []
    for j in i:
        tmp.append(j.split('_')[0])
    WMPerElementFromModeling.append(tmp)

specPerElementFromModeling = []
for i in materialNamePerElem:
    tmp = []
    for j in i:
        a = j.split('_')
        del a[0]
        b = " ".join(a)
        tmp.append(b)
    specPerElementFromModeling.append(tmp)

WMPerElementFromModeling_flat = list(itertools.chain(*WMPerElementFromModeling))
specPerElementFromModeling_flat = list(itertools.chain(*specPerElementFromModeling))

dic_WMandDescription_Model = {}
for i in range(len(WMPerElementFromModeling_flat)):
    dic_WMandDescription_Model[WMPerElementFromModeling_flat[i]] = specPerElementFromModeling_flat[i]

def findAllKeys(dict):
    result = []
    for key in dict.keys():
        result.append(key)
    return result

def findAllValues(dict):
    result = []
    for key in dict.keys():
        result.append(dict[key])
    return result

keys_WMandDescription_Model = findAllKeys(dic_WMandDescription_Model)
keys_WMandDescription_Excel = findAllKeys(dic_WMandDescription_Excel)

keys_WMandDescription_Both = list(set(keys_WMandDescription_Model + keys_WMandDescription_Excel))
values_WMandDescription_Both = []
for i in keys_WMandDescription_Both:
    if i in keys_WMandDescription_Model:
        values_WMandDescription_Both.append(dic_WMandDescription_Model[i])
    else:
        values_WMandDescription_Both.append(dic_WMandDescription_Excel[i])

dic_WMandDescription_Both = {}
for i in range(len(keys_WMandDescription_Both)):
    dic_WMandDescription_Both[keys_WMandDescription_Both[i]] = values_WMandDescription_Both[i]

workMasterCodePerElementFromBoth = []
for i in range(len(workMasterCodePerElement)):
    #tmp = []
    a = WMPerElementFromModeling[i] + workMasterCodePerElement[i]
    b = findUnique(a)
    workMasterCodePerElementFromBoth.append(b)

specPerElement = []
for i in workMasterCodePerElementFromBoth:
    tmp = []
    for j in i:
        tmp.append(dic_WMandDescription_Both[j])
    specPerElement.append(tmp)

fullWMCodeDescriptionPerElement = []
for i in range(len(workMasterCodePerElementFromBoth)):
    tmp = []
    for j in range(len(workMasterCodePerElementFromBoth[i])):
        a = workMasterCodePerElementFromBoth[i][j] +": "+ specPerElement[i][j]
        tmp.append(a)
    fullWMCodeDescriptionPerElement.append(tmp)

fullWMinfo = {
"AllElement": inputElements,
"WorkMasterCodePerFamilyType": dic_FamilyCodeandWM,
"WorkMasterCodePerElementBoth": workMasterCodePerElementFromBoth,
"FullWMCodeDescriptionPerElement": fullWMCodeDescriptionPerElement
}



result = fullWMinfo

# Assign your output to the OUT variable.
OUT = result
# ----------------------------------------

# group: Organize AllElementInform AsDictionary
set_up_all_element_inform_as = Python(IN[0]=excelDataManagerNode)  # "Set Up All Element Inform as Dictionary"; CPython3
# ---------- set_up_all_element_inform_as.python (119 lines) ----------
# Load the Python Standard and DesignScript Libraries
import os
import sys
sys.path.append(os.getenv('LOCALAPPDATA').replace('\\','\\\\') + r'\Programs\Python\Python39\Lib\site-packages')
import clr
clr.AddReference('RevitAPI')
import Autodesk

clr.AddReference('ProtoGeometry')
from Autodesk.DesignScript.Geometry import *

clr.AddReference('RevitNodes')
import Revit
clr.ImportExtensions(Revit.Elements)

clr.ImportExtensions(Revit.GeometryConversion)
clr.ImportExtensions(Revit.GeometryReferences)

clr.AddReference('RevitServices')
import RevitServices
from RevitServices.Persistence import DocumentManager
from RevitServices.Transactions import TransactionManager

doc = DocumentManager.Instance.CurrentDBDocument

import random
import itertools
from functools import reduce
from collections import Iterable
import datetime
import openpyxl

def iterable(obj):
    return isinstance(obj, Iterable)

def findUnique(inputs):
    result = []
    for i in inputs:
        if i in result:
            pass
        else:
            result.append(i)
    return result

# The inputs to this node will be stored as a list in the IN variables.
dataEnteringNode = IN
inputDict = IN[0]


def importExcel(path, SheetNameIn):
    wb_obj = openpyxl.load_workbook(str(path), data_only=True)
    sheet_obj = wb_obj.get_sheet_by_name(str(SheetNameIn))

    m_row = sheet_obj.max_row
    m_col = sheet_obj.max_column

    listOut = []

    for i in range(1, m_row +1):
        listTemp = []
        for j in range(1, m_col + 1):
            cell_obj = sheet_obj.cell(row=i, column=j)
            listTemp.append(cell_obj.value)
            if len(listTemp) == m_col:
                listOut.append(listTemp)
    return listOut

def getUsedFamilyTypeOfModeling(elements):
    familyCode = list(map(lambda x: x.Name.split('_')[0], elements))
    unq_familyCode = findUnique(familyCode)
    return unq_familyCode
    
def createExcelDataDictionary(values):
    result = {}
    for i in range(len(values)):
        result[str(i)] = values[i]
    return result

def findTargetIndex(targets, list):
    result = []
    for target in targets:
        for i in range(len(list)):
            if target in str(list[i]):
                result.append(i)
            else:
                pass
    result.sort()
    return result
    
def GetValueAtKeys(keys, dictionary):
    result = [] 
    for i in keys:
        result.append(dictionary[str(i)])
    return result


# Place your code below this line
element = inputDict["AllElement"]
elementType = []
for i in element:
    elementType.append(i.Name)
familyCode = []
for i in elementType:
    familyCode.append(i.split("_")[0])
fullWMCodeDescriptionPerElement = inputDict["FullWMCodeDescriptionPerElement"]

resultDict = {
"Element": element,
"ElementType": elementType,
"FamilyCode": familyCode,
"FullWMCodeDescriptionPerElement": fullWMCodeDescriptionPerElement
}



result = resultDict

# Assign your output to the OUT variable.
OUT = result
# ----------------------------------------

# group: 패밀리 타입 확인용
code_block_2 = CodeBlock(i=set_up_all_element_inform_as) { i["ElementType"]; }
uniqueItems = List.UniqueItems(list=code_block_2)

# group: create Element DataStructure
createElemDS = Python(IN[0]=set_up_all_element_inform_as)  # CPython3
# ---------- createElemDS.python (47 lines) ----------
# Load the Python Standard and DesignScript Libraries
import sys
import clr
clr.AddReference('ProtoGeometry')
from Autodesk.DesignScript.Geometry import *

# The inputs to this node will be stored as a list in the IN variables.
dataEnteringNode = IN
elemDics = IN[0]
elems = elemDics["Element"]
elemTypes = elemDics["ElementType"]
WMperElems = elemDics["FullWMCodeDescriptionPerElement"]
idx = range(len(elems))
# Place your code below this line
def ElemDS(i, elems, elemTypes, WMperElems):
    elem = elems[i]
    elemType = elemTypes[i]
    familyCode = elemType.split('_')[0]
    WMperElem = WMperElems[i]
    familyClass = elem.ElementType.GetParameterValueByName("Family Name")
    
    def findLevel():
        if "Wall" in familyClass:
            level = elem.GetParameterValueByName("Base Constraint")
        elif "Column" in familyClass:
            level = elem.GetParameterValueByName("Base Level")
        elif "Stair" in familyClass:
            level = elem.GetParameterValueByName("Base Level")
        elif "Beam" in familyClass:
            level = elem.GetParameterValueByName("Reference Level")
        else:
            level = elem.GetParameterValueByName("Level")
        return level
    level = findLevel()
    
    result = {
        "elem": elem,
        "elemType": elemType,
        "level": level,
        "familyCode": familyCode,
        "WMperElem": WMperElem,
    }
    
    return result

# Assign your output to the OUT variable.
OUT = [ElemDS(i, elems, elemTypes, WMperElems) for i in idx]
# ----------------------------------------

# group: 함수 인풋값
독립기초철근비 = DoubleInput(0.1)  # graph input
슬라브철근비 = DoubleInput(0.15)  # graph input
패드철근비 = DoubleInput(0.1)  # graph input
경사_비율_입력_1_x_for_isofdn = DoubleInput(2)  # graph input
온통_터파기_여부 = BoolSelector(false)  # graph input
터파기_하부_offset = DoubleInput(300)  # graph input
기층thk = DoubleInput(300)  # graph input
버림thk = DoubleInput(50)  # graph input
토량_환산_계수 = DoubleInput(1.2)  # graph input
경사_비율_입력_1_x_for_sog = DoubleInput(4)  # graph input
버림offset = DoubleInput(100)  # graph input
잡석thk = DoubleInput(100)  # graph input
code_block_3 = CodeBlock(독립기초철근비=독립기초철근비, 슬라브철근비=슬라브철근비, 패드철근비=패드철근비, 경사비율_IsoFDN=경사_비율_입력_1_x_for_isofdn, 온통터파기_여부=온통_터파기_여부, 터파기_하부Offset=터파기_하부_offset, 기층thk=기층thk, 버림thk=버림thk, 토량_환산계수=토량_환산_계수, 경사비율_SOG=경사_비율_입력_1_x_for_sog, 버림offset=버림offset, 잡석thk=잡석thk)
# ---------- code_block_3.designscript (14 lines) ----------
i = {
"독립기초철근비": 독립기초철근비,
"슬라브철근비": 슬라브철근비,
"패드철근비": 패드철근비,
"경사비율_IsoFDN": 경사비율_IsoFDN,
"온통터파기_여부": 온통터파기_여부,
"터파기_하부Offset": 터파기_하부Offset,
"기층thk": 기층thk,
"버림thk": 버림thk,
"토량_환산계수": 토량_환산계수,
"경사비율_SOG": 경사비율_SOG,
"버림offset": 버림offset,
"잡석thk": 잡석thk
};
# ----------------------------------------

# group: 콘크리트물량산출함수
stringFromWeb = Python(IN[0]=code_block_3)  # CPython3
# ---------- stringFromWeb.python (20 lines) ----------
# Load the Python Standard and DesignScript Libraries
import sys
import clr
clr.AddReference('ProtoGeometry')
from Autodesk.DesignScript.Geometry import *
import urllib.request

# The inputs to this node will be stored as a list in the IN variables.
dataEnteringNode = IN
inputURL = "https://raw.githubusercontent.com/HNANmal/mQ/master/Hdynlib/Calculation/CalculateAlgorithm/%EC%BD%98%ED%81%AC%EB%A6%AC%ED%8A%B8%EB%AC%BC%EB%9F%89%EC%82%B0%EC%B6%9C.py"
ref = IN[0]

# Place your code below this line
req = urllib.request
data = req.urlopen(inputURL)

result = data.read().decode("utf-8")

# Assign your output to the OUT variable.
OUT = [result,ref]
# ----------------------------------------
code_block_4 = CodeBlock(i=stringFromWeb) { i[0]; i[1]; }
콘크리트물량산출함수 = PythonStringNode(script=code_block_4.out0)  # CPython3; unwired: IN[0]

# group: 철근물량산출함수
stringFromWeb_2 = Python(IN[0]=code_block_3)  # CPython3
# ---------- stringFromWeb_2.python (20 lines) ----------
# Load the Python Standard and DesignScript Libraries
import sys
import clr
clr.AddReference('ProtoGeometry')
from Autodesk.DesignScript.Geometry import *
import urllib.request

# The inputs to this node will be stored as a list in the IN variables.
dataEnteringNode = IN
inputURL = "https://raw.githubusercontent.com/HNANmal/mQ/master/Hdynlib/Calculation/CalculateAlgorithm/%EC%B2%A0%EA%B7%BC%EB%AC%BC%EB%9F%89%EC%82%B0%EC%B6%9C%ED%95%A8%EC%88%98.py"
ref = IN[0]

# Place your code below this line
req = urllib.request
data = req.urlopen(inputURL)

result = data.read().decode("utf-8")

# Assign your output to the OUT variable.
OUT = [result,ref]
# ----------------------------------------

code_block_5 = CodeBlock(i=stringFromWeb_2, r=code_block_3) { i[0]; r; r["독립기초철근비"]; r["슬라브철근비"]; r["패드철근비"]; }

# group (continued): 철근물량산출함수
철근물량산출함수 = PythonStringNode(script=code_block_5.out0, IN[0]=콘크리트물량산출함수, IN[2]=code_block_5.out2, IN[3]=code_block_5.out3, IN[4]=code_block_5.out4)  # CPython3; unwired: IN[1], IN[5]

# group: 거푸집산출함수
stringFromWeb_3 = Python(IN[0]=code_block_3)  # CPython3
# ---------- stringFromWeb_3.python (20 lines) ----------
# Load the Python Standard and DesignScript Libraries
import sys
import clr
clr.AddReference('ProtoGeometry')
from Autodesk.DesignScript.Geometry import *
import urllib.request

# The inputs to this node will be stored as a list in the IN variables.
dataEnteringNode = IN
inputURL = "https://raw.githubusercontent.com/HNANmal/mQ/master/Hdynlib/Calculation/CalculateAlgorithm/%EA%B1%B0%ED%91%B8%EC%A7%91%EC%82%B0%EC%B6%9C%ED%95%A8%EC%88%98.py"
ref = IN[0]

# Place your code below this line
req = urllib.request
data = req.urlopen(inputURL)

result = data.read().decode("utf-8")

# Assign your output to the OUT variable.
OUT = [result,ref]
# ----------------------------------------
code_block_6 = CodeBlock(i=stringFromWeb_3) { i[0]; r=i[1]; }
거푸집산출함수 = PythonStringNode(script=code_block_6.out0)  # CPython3; unwired: IN[0]

# group: 프로텍션보드산출함수
stringFromWeb_4 = Python(IN[0]=code_block_3)  # CPython3
# ---------- stringFromWeb_4.python (20 lines) ----------
# Load the Python Standard and DesignScript Libraries
import sys
import clr
clr.AddReference('ProtoGeometry')
from Autodesk.DesignScript.Geometry import *
import urllib.request

# The inputs to this node will be stored as a list in the IN variables.
dataEnteringNode = IN
inputURL = "https://raw.githubusercontent.com/HNANmal/mQ/master/Hdynlib/Calculation/CalculateAlgorithm/%ED%94%84%EB%A1%9C%ED%85%8D%EC%85%98%EB%B3%B4%EB%93%9C%EC%82%B0%EC%B6%9C%ED%95%A8%EC%88%98.py"
ref = IN[0]

# Place your code below this line
req = urllib.request
data = req.urlopen(inputURL)

result = data.read().decode("utf-8")

# Assign your output to the OUT variable.
OUT = [result,ref]
# ----------------------------------------
code_block_7 = CodeBlock(i=stringFromWeb_4) { i[0]; r=i[1]; }
프로텍션보드산출함수 = PythonStringNode(script=code_block_7.out0)  # CPython3; unwired: IN[0], IN[1], IN[2], IN[3], IN[4], IN[5]

funcSets = Python(IN[0]=콘크리트물량산출함수, IN[1]=철근물량산출함수, IN[2]=거푸집산출함수, IN[3]=프로텍션보드산출함수)  # CPython3
# ---------- funcSets.python (13 lines) ----------
# Load the Python Standard and DesignScript Libraries
import sys
import clr
clr.AddReference('ProtoGeometry')
from Autodesk.DesignScript.Geometry import *

# The inputs to this node will be stored as a list in the IN variables.
dataEnteringNode = IN

# Place your code below this line

# Assign your output to the OUT variable.
OUT = IN
# ----------------------------------------

# group: 터파기산출함수
stringFromWeb_5 = Python(IN[0]=code_block_4.out1)  # CPython3
# ---------- stringFromWeb_5.python (20 lines) ----------
# Load the Python Standard and DesignScript Libraries
import sys
import clr
clr.AddReference('ProtoGeometry')
from Autodesk.DesignScript.Geometry import *
import urllib.request

# The inputs to this node will be stored as a list in the IN variables.
dataEnteringNode = IN
inputURL = "https://raw.githubusercontent.com/HNANmal/mQ/master/Hdynlib/Calculation/CalculateAlgorithm/%ED%84%B0%ED%8C%8C%EA%B8%B0%EC%82%B0%EC%B6%9C%ED%95%A8%EC%88%98.py"
ref = IN[0]

# Place your code below this line
req = urllib.request
data = req.urlopen(inputURL)

result = data.read().decode("utf-8")

# Assign your output to the OUT variable.
OUT = [result,ref]
# ----------------------------------------
code_block_8 = CodeBlock(i=stringFromWeb_5) { i[0]; r=i[1]; r["온통터파기_여부"]; r["터파기_하부Offset"]; r["버림thk"]; r["경사비율_IsoFDN"]; }
터파기산출함수 = PythonStringNode(script=code_block_8.out0, IN[2]=code_block_8.out2, IN[3]=code_block_8.out3, IN[4]=code_block_8.out4, IN[5]=code_block_8.out5)  # CPython3; unwired: IN[0], IN[1]

# group: 되메우기산출함수
stringFromWeb_6 = Python(IN[0]=code_block_5.r)  # CPython3; unwired: IN[1], IN[2]
# ---------- stringFromWeb_6.python (20 lines) ----------
# Load the Python Standard and DesignScript Libraries
import sys
import clr
clr.AddReference('ProtoGeometry')
from Autodesk.DesignScript.Geometry import *
import urllib.request

# The inputs to this node will be stored as a list in the IN variables.
dataEnteringNode = IN
inputURL = "https://raw.githubusercontent.com/HNANmal/mQ/master/Hdynlib/Calculation/CalculateAlgorithm/%EB%90%98%EB%A9%94%EC%9A%B0%EA%B8%B0%EC%82%B0%EC%B6%9C%ED%95%A8%EC%88%98.py"
ref = IN[0]

# Place your code below this line
req = urllib.request
data = req.urlopen(inputURL)

result = data.read().decode("utf-8")

# Assign your output to the OUT variable.
OUT = [result,ref]
# ----------------------------------------
code_block_9 = CodeBlock(i=stringFromWeb_6, r=code_block_5.r) { i[0]; r; r["온통터파기_여부"]; }
되메우기산출함수 = Python(IN[0]=터파기산출함수, IN[2]=code_block_9.out2)  # CPython3; unwired: IN[1], IN[3], IN[4], IN[5]
# ---------- 되메우기산출함수.python (80 lines) ----------
# Load the Python Standard and DesignScript Libraries
import sys
import clr

clr.AddReference('RevitAPI')
from Autodesk.Revit.DB import *
import Autodesk

clr.AddReference('RevitNodes')
import Revit
clr.ImportExtensions(Revit.Elements)

clr.AddReference('RevitServices')
import RevitServices
from RevitServices.Persistence import DocumentManager
doc = DocumentManager.Instance.CurrentDBDocument
collector1 = FilteredElementCollector(doc)
collector2 = FilteredElementCollector(doc)
collector3 = FilteredElementCollector(doc)
collector4 = FilteredElementCollector(doc)

clr.AddReference('ProtoGeometry')
from Autodesk.DesignScript.Geometry import *

from itertools import chain

allFdns = collector1.OfCategory(BuiltInCategory.OST_StructuralFoundation).WhereElementIsNotElementType().ToElements()
allCols = collector2.OfCategory(BuiltInCategory.OST_StructuralColumns).WhereElementIsNotElementType().ToElements()
allBeams = collector3.OfCategory(BuiltInCategory.OST_StructuralFraming).WhereElementIsNotElementType().ToElements()
allFloors = collector4.OfCategory(BuiltInCategory.OST_Floors).WhereElementIsNotElementType().ToElements()
allIsoFdns = [i.ToDSType(False) for i in allFdns if "Footing-" in i.Name]
allPeds = [i.ToDSType(False) for i in allCols if "UG" in i.Name]
allPedsGeo = [i.Geometry()[0] for i in allPeds]
allTGs = [i.ToDSType(False) for i in allBeams if "UG" in i.Name] #[i.ToDSType(False) for i in allBeams if "TG" in i.Name]
allTGsGeo = list(chain(*[i.Geometry() for i in allTGs]))
allSOGs = [i.ToDSType(False) for i in allFdns if "SOG" in i.Name and "GS" in i.Name]
allSOGsGeo = [i.Geometry()[0] for i in allSOGs]

# The inputs to this node will be stored as a list in the IN variables.
dataEnteringNode = IN
refFunc = IN[0][0]
input = IN[1]
wholeExcavationBln = IN[2]
bttmOffset = IN[3]
버림thk = IN[4]
slopeExcav = IN[5]


# Place your code below this line

def 되메우기산출함수(input):
    targets = []
    
    if wholeExcavationBln:
        calcTargetNum = len(allIsoFdns)
        exca_solid = refFunc(input)[0]
        fdn_solid = list(chain(*[i.Geometry() for i in allIsoFdns]))
        _diff_target = fdn_solid + allPedsGeo + allTGsGeo + allSOGsGeo
        diff_target = Solid.ByUnion(_diff_target)

        target = exca_solid.Difference(diff_target)
        

    else:
        calcTargetNum = 1
        exca_solid = refFunc(input)[0]
        fdn_solid = input.Geometry()[0]
        _joinedPeds = [i for i in allPedsGeo if i.DoesIntersect(exca_solid)]
        _joinedTGs = [i for i in allTGsGeo if i.DoesIntersect(exca_solid)]
        _joinedSOGs = [i for i in allSOGsGeo if i.DoesIntersect(exca_solid)]
        _diff_target = [fdn_solid] + _joinedPeds + _joinedTGs + _joinedSOGs
        diff_target = Solid.ByUnion(_diff_target)
        
        target = exca_solid.Difference(diff_target)

    return (target, sum([i.Volume for i in [target]])/calcTargetNum/1000000000, "M3")

# Assign your output to the OUT variable.
#OUT = getBackfillTarget(input)
OUT = (되메우기산출함수,["Footing-Rectangular"],["Backfill"],["M3"])
# ----------------------------------------

# group: 기층물량산출함수
stringFromWeb_7 = Python(IN[0]=code_block_6.r)  # CPython3
# ---------- stringFromWeb_7.python (20 lines) ----------
# Load the Python Standard and DesignScript Libraries
import sys
import clr
clr.AddReference('ProtoGeometry')
from Autodesk.DesignScript.Geometry import *
import urllib.request

# The inputs to this node will be stored as a list in the IN variables.
dataEnteringNode = IN
inputURL = "https://raw.githubusercontent.com/HNANmal/mQ/master/Hdynlib/Calculation/CalculateAlgorithm/%EA%B8%B0%EC%B8%B5%EB%AC%BC%EB%9F%89%EC%82%B0%EC%B6%9C%ED%95%A8%EC%88%98.py"
ref = IN[0]

# Place your code below this line
req = urllib.request
data = req.urlopen(inputURL)

result = data.read().decode("utf-8")

# Assign your output to the OUT variable.
OUT = [result,ref]
# ----------------------------------------
code_block_10 = CodeBlock(i=stringFromWeb_7) { i[0]; r=i[1]; r["온통터파기_여부"]; r["터파기_하부Offset"]; r["기층thk"]; r["버림thk"]; }
기층물량산출함수 = PythonStringNode(script=code_block_10.out0, IN[0]=터파기산출함수, IN[2]=code_block_10.out2, IN[3]=code_block_10.out3, IN[4]=code_block_10.out4, IN[5]=code_block_10.out5)  # CPython3; unwired: IN[1]

# group: 잔토처리산출함수
stringFromWeb_8 = Python(IN[0]=code_block_7.r)  # CPython3; unwired: IN[1]
# ---------- stringFromWeb_8.python (20 lines) ----------
# Load the Python Standard and DesignScript Libraries
import sys
import clr
clr.AddReference('ProtoGeometry')
from Autodesk.DesignScript.Geometry import *
import urllib.request

# The inputs to this node will be stored as a list in the IN variables.
dataEnteringNode = IN
inputURL = "https://raw.githubusercontent.com/HNANmal/mQ/master/Hdynlib/Calculation/CalculateAlgorithm/%EC%9E%94%ED%86%A0%EC%B2%98%EB%A6%AC%EC%82%B0%EC%B6%9C%ED%95%A8%EC%88%98.py"
ref = IN[0]

# Place your code below this line
req = urllib.request
data = req.urlopen(inputURL)

result = data.read().decode("utf-8")

# Assign your output to the OUT variable.
OUT = [result,ref]
# ----------------------------------------
code_block_11 = CodeBlock(i=stringFromWeb_8) { i[0]; r=i[1]; r["온통터파기_여부"]; r["토량_환산계수"]; }
잔토처리산출함수 = PythonStringNode(script=code_block_11.out0, IN[0]=터파기산출함수, IN[2]=code_block_11.out2, IN[3]=code_block_11.out3)  # CPython3; unwired: IN[1]

funcSets_2 = Python(IN[0]=터파기산출함수, IN[1]=되메우기산출함수, IN[2]=기층물량산출함수, IN[3]=잔토처리산출함수)  # CPython3; same code as funcSets

# group: 터파기산출함수_SOG
stringFromWeb_9 = Python(IN[0]=code_block_8.r)  # CPython3
# ---------- stringFromWeb_9.python (20 lines) ----------
# Load the Python Standard and DesignScript Libraries
import sys
import clr
clr.AddReference('ProtoGeometry')
from Autodesk.DesignScript.Geometry import *
import urllib.request

# The inputs to this node will be stored as a list in the IN variables.
dataEnteringNode = IN
inputURL = "https://raw.githubusercontent.com/HNANmal/mQ/master/Hdynlib/Calculation/CalculateAlgorithm/%ED%84%B0%ED%8C%8C%EA%B8%B0%EC%82%B0%EC%B6%9C%ED%95%A8%EC%88%98_SOG.py"
ref = IN[0]

# Place your code below this line
req = urllib.request
data = req.urlopen(inputURL)

result = data.read().decode("utf-8")

# Assign your output to the OUT variable.
OUT = [result,ref]
# ----------------------------------------
code_block_12 = CodeBlock(i=stringFromWeb_9) { i[0]; r=i[1]; r["온통터파기_여부"]; r["터파기_하부Offset"]; r["버림thk"]; r["경사비율_SOG"]; }
터파기산출함수_SOG = PythonStringNode(script=code_block_12.out0, IN[2]=code_block_12.out2, IN[3]=code_block_12.out3, IN[4]=code_block_12.out4, IN[5]=code_block_12.out5)  # CPython3; unwired: IN[0], IN[1]

funcSets_3 = Python(IN[0]=터파기산출함수_SOG)  # CPython3; same code as funcSets

# group: 버림콘크리트산출함수
stringFromWeb_10 = Python(IN[0]=code_block_12.r)  # CPython3
# ---------- stringFromWeb_10.python (20 lines) ----------
# Load the Python Standard and DesignScript Libraries
import sys
import clr
clr.AddReference('ProtoGeometry')
from Autodesk.DesignScript.Geometry import *
import urllib.request

# The inputs to this node will be stored as a list in the IN variables.
dataEnteringNode = IN
inputURL = "https://raw.githubusercontent.com/HNANmal/mQ/master/Hdynlib/Calculation/CalculateAlgorithm/%EB%B2%84%EB%A6%BC%EC%BD%98%ED%81%AC%EB%A6%AC%ED%8A%B8%EC%82%B0%EC%B6%9C%ED%95%A8%EC%88%98.py"
ref = IN[0]

# Place your code below this line
req = urllib.request
data = req.urlopen(inputURL)

result = data.read().decode("utf-8")

# Assign your output to the OUT variable.
OUT = [result,ref]
# ----------------------------------------
code_block_13 = CodeBlock(i=stringFromWeb_10) { i[0]; r=i[1]; r["터파기_하부Offset"]; r["터파기_하부Offset"]; r["버림thk"]; r["버림offset"]; }
버림콘크리트산출함수 = PythonStringNode(script=code_block_13.out0, IN[2]=code_block_13.out2, IN[3]=code_block_13.out3, IN[4]=code_block_13.out4, IN[5]=code_block_13.out5)  # CPython3; unwired: IN[0], IN[1]

# group: 잡석다짐산출함수
stringFromWeb_11 = Python(IN[0]=code_block_12.r)  # CPython3
# ---------- stringFromWeb_11.python (20 lines) ----------
# Load the Python Standard and DesignScript Libraries
import sys
import clr
clr.AddReference('ProtoGeometry')
from Autodesk.DesignScript.Geometry import *
import urllib.request

# The inputs to this node will be stored as a list in the IN variables.
dataEnteringNode = IN
inputURL = "https://raw.githubusercontent.com/HNANmal/mQ/master/Hdynlib/Calculation/CalculateAlgorithm/%EC%9E%A1%EC%84%9D%EB%8B%A4%EC%A7%90%EC%82%B0%EC%B6%9C%ED%95%A8%EC%88%98.py"
ref = IN[0]

# Place your code below this line
req = urllib.request
data = req.urlopen(inputURL)

result = data.read().decode("utf-8")

# Assign your output to the OUT variable.
OUT = [result,ref]
# ----------------------------------------
code_block_14 = CodeBlock(i=stringFromWeb_11) { i[0]; r=i[1]; r["잡석thk"]; }
잡석다짐산출함수 = PythonStringNode(script=code_block_14.out0, IN[0]=버림콘크리트산출함수, IN[2]=code_block_14.out2)  # CPython3; unwired: IN[1], IN[3], IN[4], IN[5]

# group: PE시트산출함수
stringFromWeb_12 = Python(IN[0]=code_block_12.r)  # CPython3
# ---------- stringFromWeb_12.python (20 lines) ----------
# Load the Python Standard and DesignScript Libraries
import sys
import clr
clr.AddReference('ProtoGeometry')
from Autodesk.DesignScript.Geometry import *
import urllib.request

# The inputs to this node will be stored as a list in the IN variables.
dataEnteringNode = IN
inputURL = "https://raw.githubusercontent.com/HNANmal/mQ/master/Hdynlib/Calculation/CalculateAlgorithm/PE%EC%8B%9C%ED%8A%B8%EC%82%B0%EC%B6%9C%ED%95%A8%EC%88%98.py"
ref = IN[0]

# Place your code below this line
req = urllib.request
data = req.urlopen(inputURL)

result = data.read().decode("utf-8")

# Assign your output to the OUT variable.
OUT = [result,ref]
# ----------------------------------------
code_block_15 = CodeBlock(i=stringFromWeb_12) { i[0]; r=i[1]; r["버림thk"]; }
PE시트산출함수 = PythonStringNode(script=code_block_15.out0, IN[0]=버림콘크리트산출함수, IN[2]=code_block_15.out2)  # CPython3; unwired: IN[1]

funcSets_4 = Python(IN[0]=버림콘크리트산출함수, IN[1]=잡석다짐산출함수, IN[2]=PE시트산출함수)  # CPython3; same code as funcSets
join = List.Join(list0=funcSets, list1=funcSets_2, list2=funcSets_3, list3=funcSets_4)
getTargetAndValue = Python(IN[0]=createElemDS, IN[1]=join)  # CPython3
# ---------- getTargetAndValue.python (83 lines) ----------
# Load the Python Standard and DesignScript Libraries
import sys
import clr
clr.AddReference('ProtoGeometry')
from Autodesk.DesignScript.Geometry import *

from itertools import chain

# The inputs to this node will be stored as a list in the IN variables.
dataEnteringNode = IN
elemDSs = IN[0]
funcSets = IN[1]
#func = IN[1][0]
#funcfamilyTag = IN[1][1]
#funcWmTag = IN[1][2]
#funcUnitTag = IN[1][3]
# Place your code below this line


def getTarget(elemDS, funcSets):
    elem = elemDS["elem"]
    etype = elemDS["elemType"]
    familyCode = elemDS["familyCode"]
    wms = elemDS["WMperElem"]
    result = []
    
#    def matchWM_func(wms, funcSet):
#        result = []
#        func = funcSet[0]
#        for wm in wms:
#            tmp1 = []
#            tmp2 = []
#            wmbln = []
#            for i in funcSet[1]:
#                if i in etype:#element type 비교
#                    tmp1.append(True)
#                else:
#                    tmp1.append(False)
#            for i in funcSet[2]:#work type 비교
#                if i in wm:
#                    tmp2.append(True)
#                else:
#                    tmp2.append(False)
#            if any(tmp1) and any(tmp2):
#                result.append([etype, wm, func, func(elem)])
#
#        return result
    
    def matchWM_func(wm, funcSets):
        result = []
        
        for funcSet in funcSets:
            func = funcSet[0]
            tmp1 = []
            tmp2 = []

            for i in funcSet[1]:
                if i in etype:#element type 비교
                    tmp1.append(True)
                else:
                    tmp1.append(False)
            for i in funcSet[2]:#work type 비교
                if i in wm:
                    tmp2.append(True)
                else:
                    tmp2.append(False)
            if any(tmp1) and any(tmp2):
                result.append([etype, wm, func, func(elem)])

        return result

#    result = [matchWM_func(wm, funcSets) for wm in wms]
    result = []
    for wm in wms:
        if matchWM_func(wm, funcSets):
            result.append(matchWM_func(wm, funcSets))
        else:
            result.append([[etype, wm, "-----!!funcSets내, 해당 부재와 해당 공정"+f'({wm.split(": ")[0]})'+"에 대응하는 함수 없음!!-----",["!산출타겟 미지정!","!산출결과 없음!","!산출단위 없음!"]]])

    return list(chain(*result))

# Assign your output to the OUT variable.
OUT = [getTarget(elemDS, funcSets) for elemDS in elemDSs]
# ----------------------------------------

# group: 산출타겟 검증(시각화)
code_block_16 = CodeBlock(input=getTargetAndValue) { input; }
공종목록 = Python(IN[0]=code_block_16)  # CPython3
# ---------- 공종목록.python (34 lines) ----------
# Load the Python Standard and DesignScript Libraries
import sys
import clr
clr.AddReference('ProtoGeometry')
from Autodesk.DesignScript.Geometry import *

clr.AddReference('RevitNodes')
import Revit
clr.ImportExtensions(Revit.Elements)

from DSCore import Color
clr.AddReference('GeometryColor')
from Modifiers import GeometryColor

import random

# The inputs to this node will be stored as a list in the IN variables.
dataEnteringNode = IN
산출결과세트리스트 = IN[0]

def 공종종류(산출결과세트리스트):
    result = []
    for 산출결과세트 in 산출결과세트리스트:
        for i in 산출결과세트:
            공종 = i[1]
            if not 공종 in result:
                result.append(공종)
    return result
    
공종목록 = 공종종류(산출결과세트리스트)

result = 공종목록
# Assign your output to the OUT variable.
OUT = result
# ----------------------------------------
watch = Watch(공종목록)
integer_slider = IntegerSlider(1, range=0..18 step 1)
code_block_17 = CodeBlock(i=watch, j=integer_slider) { i[j]; }
code_block_18 = CodeBlock(i=code_block_17) { String.Split(i, ": ")[1]; }
watch_2 = Watch(code_block_18)
선으로_보기 = BoolSelector(true)
color_palette = ColorPalette({R: 0, G: 0, B: 0, A: 106})
산출타겟_검증 = Python(IN[0]=선으로_보기, IN[1]=color_palette, IN[2]=code_block_16, IN[3]=code_block_17)  # CPython3
# ---------- 산출타겟_검증.python (126 lines) ----------
# Load the Python Standard and DesignScript Libraries
import sys
import clr
clr.AddReference('ProtoGeometry')
from Autodesk.DesignScript.Geometry import *

clr.AddReference('RevitNodes')
import Revit
clr.ImportExtensions(Revit.Elements)

from DSCore import Color
clr.AddReference('GeometryColor')
from Modifiers import GeometryColor

import random
from itertools import chain

# The inputs to this node will be stored as a list in the IN variables.
dataEnteringNode = IN
선보기여부 = IN[0]
지정색상 = IN[1]
산출결과세트리스트 = IN[2]
공종코드 = IN[3].split(': ')[0]

def listFlatten(inlist):
    result = []
    for i in inlist:
        if isinstance(i, list):
            result += (listFlatten(i))
        else:
            result.append(i)
    return result

def 공종종류(산출결과세트리스트):
    result = []
    for 산출결과세트 in 산출결과세트리스트:
        for i in 산출결과세트:
            공종 = i[1].split(': ')[0]
            if not 공종 in result:
                result.append(공종)
    return result
    
공종목록 = 공종종류(산출결과세트리스트)

def 색상준비(공종목록):
    log = []
    result = {}
    for i in range(len(공종목록)):
        난수1 = random.randint(0,255)
        난수2 = random.randint(0,255)
        난수3 = random.randint(0,255)
        난수4 = random.randint(0,255)
        색상 = Color.ByARGB(난수1,난수2,난수3,난수4)
        if not 색상 in log:
            log.append(색상)
            result[공종목록[i]] = 색상
    return result
    
색상들 = 색상준비(공종목록)
# Place your code below this line
def 시각화(산출결과세트, 색상들, 공종코드):
    result = []
    for 공종결과 in 산출결과세트:
        tmp1 = []
        target = 공종결과[3][0]
        공종 = 공종결과[1].split(': ')[0]
        색상 = 지정색상
        if 공종 == 공종코드:
            if isinstance(target, Revit.Elements.FamilyInstance):
                visual = GeometryColor.ByGeometryColor(target.Geometry()[0], 색상)[0]
                tmp1.append(visual)
            elif isinstance(target, str):
                pass
            else:
                if not isinstance(target, list):
                    visual = GeometryColor.ByGeometryColor(target, 색상)
                    tmp1.append(visual)
                else:
                    for i in target:
                        tmp1.append(GeometryColor.ByGeometryColor(i, 색상))
            result.append(tmp1)
        else:
            pass
    return result

def 시각화_선보기(산출결과세트, 공종코드):
    result = []
    for 공종결과 in 산출결과세트:
        tmp1 = []
        target = 공종결과[3][0]
        공종 = 공종결과[1].split(': ')[0]
        색상 = 지정색상
        if 공종 == 공종코드:
            if isinstance(target, Revit.Elements.FamilyInstance):
                mass = target.Geometry()[0].Explode()
                lines = list(chain(*listFlatten([i.PerimeterCurves() for i in mass])))
                visual = [GeometryColor.ByGeometryColor(i, 색상) for i in lines]
                tmp1.append(visual)
            elif isinstance(target, str):
                pass
            else:
                if not isinstance(target, list):
                    mass = target.Explode()
                    lines = list(chain(*listFlatten([i.PerimeterCurves() for i in mass])))
                    visual = [GeometryColor.ByGeometryColor(i, 색상) for i in lines]
                    tmp1.append(visual)
                else:
                    for i in target:
                        mass = i.Explode()
                        lines = list(chain(*listFlatten([i.PerimeterCurves() for i in mass])))
                        visual = [GeometryColor.ByGeometryColor(i, 색상) for i in lines]
                        tmp1.append(visual)

            result.append(tmp1)
        else:
            pass
    return result



if 선보기여부:
    result = [시각화_선보기(산출결과세트, 공종코드) for 산출결과세트 in 산출결과세트리스트]
else:
    result = [시각화(산출결과세트, 색상들, 공종코드) for 산출결과세트 in 산출결과세트리스트]
# Assign your output to the OUT variable.
OUT = [list(chain(*result))]
# ----------------------------------------

# group: 산출타겟 검증(시각화)
선으로_보기_2 = BoolSelector(false)
color_palette_2 = ColorPalette({R: 255, G: 0, B: 255, A: 41})
code_block_19 = CodeBlock(input=getTargetAndValue) { input; }
공종목록_2 = Python(IN[0]=code_block_19)  # CPython3; same code as 공종목록
watch_3 = Watch(공종목록_2)
integer_slider_2 = IntegerSlider(2, range=0..18 step 1)
code_block_20 = CodeBlock(i=watch_3, j=integer_slider_2) { i[j]; }
산출타겟_검증_2 = Python(IN[0]=선으로_보기_2, IN[1]=color_palette_2, IN[2]=code_block_19, IN[3]=code_block_20)  # CPython3; same code as 산출타겟_검증
code_block_21 = CodeBlock(i=code_block_20) { String.Split(i, ": ")[1]; }
watch_4 = Watch(code_block_21)

# group: 공종목록 확인
공종목록_3 = Python(IN[0]=getTargetAndValue)  # CPython3; same code as 공종목록
watch_5 = Watch(공종목록_3)

# group: 산출타겟 검증(시각화)
code_block_22 = CodeBlock(input=getTargetAndValue) { input; }
공종목록_4 = Python(IN[0]=code_block_22)  # CPython3; same code as 공종목록
watch_6 = Watch(공종목록_4)
integer_slider_3 = IntegerSlider(4, range=0..18 step 1)
code_block_23 = CodeBlock(i=watch_6, j=integer_slider_3) { i[j]; }
code_block_24 = CodeBlock(i=code_block_23) { String.Split(i, ": ")[1]; }
watch_7 = Watch(code_block_24)
선으로_보기_3 = BoolSelector(false)
color_palette_3 = ColorPalette({R: 51, G: 127, B: 80, A: 130})
산출타겟_검증_3 = Python(IN[0]=선으로_보기_3, IN[1]=color_palette_3, IN[2]=code_block_22, IN[3]=code_block_23)  # CPython3; same code as 산출타겟_검증

# group: 부재 항목 별 WM 매칭 검증
watch_8 = Watch(getTargetAndValue)

# group: Excel Export
data_arrange_for_excel = Python(IN[0]=watch_8)  # CPython3
# ---------- data_arrange_for_excel.python (34 lines) ----------
# Load the Python Standard and DesignScript Libraries
import sys
import clr
clr.AddReference('ProtoGeometry')
from Autodesk.DesignScript.Geometry import *

# The inputs to this node will be stored as a list in the IN variables.
dataEnteringNode = IN
lists = IN[0]
# Place your code below this line

def arrangeDataForExcel(lists):
    result = []
    for elem in lists:
        for wm in elem:
            tmp1 = []
            if "-!!" in str(wm[2]):
                pass
            else:
                tmp1 = []
                tmp1.append(wm[0])
                tmp1.append(wm[1].split(': ')[0])
                tmp1.append(wm[1].split(': ')[1])
                tmp1.append(round(wm[3][1],2))
                tmp1.append(wm[3][2])
            if tmp1:
                result.append(tmp1)
            else:
                pass
    return result

result = arrangeDataForExcel(lists)
# Assign your output to the OUT variable.
OUT = result
# ----------------------------------------
python_script_export_excel_by = Python(IN[0]=data_arrange_for_excel)  # "Python Script@Export Excel(By OpenpyXl)"; CPython3
# ---------- python_script_export_excel_by.python (158 lines) ----------
# Load the Python Standard and DesignScript Libraries
import sys
import os
#sys.path.append(r'C:\Users\HEC\AppData\Local\Programs\Python\Python39\Lib\site-packages')
#sys.path.append(r'C:\Users\pjmk0\AppData\Local\Programs\Python\Python39\Lib\site-packages')
sys.path.append(os.getenv('LOCALAPPDATA').replace('\\','\\\\') + r'\Programs\Python\Python39\Lib\site-packages')
import clr
clr.AddReference('ProtoGeometry')
from Autodesk.DesignScript.Geometry import *
from collections import Iterable

def iterable(obj):
    return isinstance(obj, Iterable)


# The inputs to this node will be stored as a list in the IN variables.
dataEnteringNode = IN
ListIn = IN[0]

# Place your code below this line
import datetime
from datetime import date, timedelta
Today = date.today()
import openpyxl
from openpyxl.styles import Border, Side, PatternFill, Font, GradientFill, Alignment, Color, numbers

sample_items = ListIn


def write_to_file(filepath):
    wb = openpyxl.Workbook()
    for sheet in wb.sheetnames:
        wb.remove(wb[sheet])

    thin = Side(border_style="thin", color="000000")
    double = Side(border_style="double", color="000000")

    ws = wb.create_sheet(title='Str Foundation', index=0)

    ws.merge_cells('A1:L1')
    ws['A1'] = 'HEC Structural Foundation Category Calculation Sheet'
    cell = ws['A1']
    cell.font = openpyxl.styles.Font(color='000000', size=20)
    cell.fill = openpyxl.styles.fills.PatternFill(patternType='solid',
                                                  fgColor=openpyxl.styles.colors.Color(rgb='fff3b0'))

    ws['A2'] = 'Item Number'
    ws['A2'].font = openpyxl.styles.Font(b=True, color='000000', size=12)
    #ws['B2'] = 'Member Name'
    #ws['B2'].font = openpyxl.styles.Font(b=True, color='000000', size=12)
    #ws['C2'] = 'Category'
    #ws['C2'].font = openpyxl.styles.Font(b=True, color='000000', size=12)
    ws['B2'] = 'Family Type'
    ws['B2'].font = openpyxl.styles.Font(b=True, color='000000', size=12)
    ws['C2'] = 'WorkMaster Code'
    ws['C2'].font = openpyxl.styles.Font(b=True, color='000000', size=12)
    ws['D2'] = 'Description'
    ws['D2'].font = openpyxl.styles.Font(b=True, color='000000', size=12)
    #ws['F2'] = 'WorkMaster Description'
    #ws['F2'].font = openpyxl.styles.Font(b=True, color='000000', size=12)
    #ws['G2'] = 'Unit'
    #ws['G2'].font = openpyxl.styles.Font(b=True, color='000000', size=12)
    #ws['H2'] = '계수'
    #ws['H2'].font = openpyxl.styles.Font(b=True, color='000000', size=12)
    #ws['I2'] = '계산 참조값'
    #ws['I2'].font = openpyxl.styles.Font(b=True, color='000000', size=12)
    ws['E2'] = 'Quantities'
    ws['E2'].font = openpyxl.styles.Font(b=True, color='000000', size=12)
    ws['F2'] = 'Unit'
    ws['F2'].font = openpyxl.styles.Font(b=True, color='000000', size=12)
    ws['G2'] = 'Unit Price'
    ws['G2'].font = openpyxl.styles.Font(b=True, color='000000', size=12)
    ws['H2'] = 'Total Price'
    ws['H2'].font = openpyxl.styles.Font(b=True, color='000000', size=12)


## 칼럼별 너비 조정 구간
#    for col in range(ws.max_column):
#        ws.column_dimensions[chr(ord('A') + col)].width = 15
    ws.column_dimensions['A'].width = 15
    ws.column_dimensions['B'].width = 45
    ws.column_dimensions['C'].width = 25
    ws.column_dimensions['D'].width = 60
    ws.column_dimensions['E'].width = 15
    ws.column_dimensions['F'].width = 20
    ws.column_dimensions['G'].width = 20
    ws.column_dimensions['H'].width = 20
    #ws.column_dimensions['G'].width = 9
    #ws.column_dimensions['H'].width = 9
    #ws.column_dimensions['H'].hidden = True
    #ws.column_dimensions['I'].width = 12
    #ws.column_dimensions['I'].hidden = True
    #ws.column_dimensions['J'].width = 12
    #ws.column_dimensions['K'].width = 12
    #ws.column_dimensions['L'].width = 12

###
    start_row = 3
    for (row, item) in enumerate(sample_items, start_row):
        cell = ws.cell(row=row, column=1, value=row - 2)
        #cell.number_format = openpyxl.styles.numbers.builtin_format_code(0)
        cell.alignment = openpyxl.styles.Alignment(horizontal='center', vertical='center')

#        cell = ws.cell(row=row, column=2, value=item[0])
#        cell.number_format = openpyxl.styles.numbers.FORMAT_DATE_YYYYMMDD2  # 'yyyy-mm-dd'
        ws.cell(row=row, column=2, value=item[0]) ## Family Type 칼럼

        ws.cell(row=row, column=3, value=item[1]) ## WorkMaster Code 칼럼
        
        ws.cell(row=row, column=4, value=item[2]) ## WorkMaster Code 칼럼
        
        ws.cell(row=row, column=5, value=item[3]) ## Quantities 칼럼
        cell.number_format = '#,##0.00'
        
        ws.cell(row=row, column=6, value=item[4]) ## Unit 칼럼
        
        #cell = ws.cell(row=row, column=8, value=item[6]) ## 계수 칼럼
        #cell.number_format = openpyxl.styles.numbers.builtin_format_code(3)  # '#,##0'
        
        #cell = ws.cell(row=row, column=9, value=item[7]) ## 계산 참조값 칼럼
        #cell.number_format = openpyxl.styles.numbers.builtin_format_code(3)  # '#,##0'
        
        #cell = ws.cell(row=row, column=10, value=item[8]) ## Quantities 칼럼
        #cell.number_format = openpyxl.styles.numbers.builtin_format_code(3)  # '#,##0'
        #cell.font = openpyxl.styles.Font(b=True, color='000000', size=11)

        cell = ws.cell(row=row, column=8, value='= E{current_row}*G{current_row}'.format(current_row=cell.row))
        cell.number_format = '#,##0.00'

#        cell = ws.cell(row=row, column=6, value='= D{current_row} * E{current_row}'.format(current_row=cell.row))
#        cell.number_format = openpyxl.styles.numbers.builtin_format_code(3)

    total_row = ws.max_row + 1
    if total_row > start_row:
        cell1 = ws.cell(row=total_row, column=7, value='Total')
        cell1.font = openpyxl.styles.Font(b=True, color='000000', size=15)
        
        cell2 = ws.cell(row=total_row, column=8, value='= SUM(H{}:H{})'.format(start_row, total_row - 1))
        cell2.number_format = openpyxl.styles.numbers.builtin_format_code(3)
        cell2.border = Border(top=double, left=double, right=double, bottom=double)
        cell2.font = openpyxl.styles.Font(b=True, color='ff03ce', size=15)
    

    wb.save(filepath)
    wb.close()


##if __name__ == '__main__':
#write_to_file('C:\\Users\\pjmk0\\AppData\\Roaming\\test.xlsx')

save_name = "HecStrFDNCalcSheet_" + Today.strftime("%Y-%m-%d")+".xlsx"
path = os.getenv('APPDATA').replace('\\','\\\\')
filePath = path + '\\' + save_name

write_to_file(filePath)

# Assign your output to the OUT variable.
OUT = os.getenv('APPDATA')
# ----------------------------------------

# group: 산출타겟 검증(시각화)
code_block_25 = CodeBlock(input=getTargetAndValue) { input; }
공종목록_5 = Python(IN[0]=code_block_25)  # CPython3; same code as 공종목록
watch_9 = Watch(공종목록_5)
integer_slider_4 = IntegerSlider(6, range=0..18 step 1)
code_block_26 = CodeBlock(i=watch_9, j=integer_slider_4) { i[j]; }
code_block_27 = CodeBlock(i=code_block_26) { String.Split(i, ": ")[1]; }
watch_10 = Watch(code_block_27)
선으로_보기_4 = BoolSelector(false)
color_palette_4 = ColorPalette({R: 210, G: 105, B: 30, A: 141})
산출타겟_검증_4 = Python(IN[0]=선으로_보기_4, IN[1]=color_palette_4, IN[2]=code_block_25, IN[3]=code_block_26)  # CPython3; same code as 산출타겟_검증

하드너물량산출함수 = Python()  # CPython3; unwired: IN[0]
# ---------- 하드너물량산출함수.python (61 lines) ----------
# Load the Python Standard and DesignScript Libraries
import sys
import clr
clr.AddReference('RevitAPI')
from Autodesk.Revit.DB import *
import Autodesk

clr.AddReference('RevitNodes')
import Revit
clr.ImportExtensions(Revit.Elements)

clr.AddReference('RevitServices')
import RevitServices
from RevitServices.Persistence import DocumentManager
doc = DocumentManager.Instance.CurrentDBDocument
collector1 = FilteredElementCollector(doc)
collector2 = FilteredElementCollector(doc)
collector3 = FilteredElementCollector(doc)
collector4 = FilteredElementCollector(doc)
collector5 = FilteredElementCollector(doc)

clr.AddReference('ProtoGeometry')
from Autodesk.DesignScript.Geometry import *

from itertools import chain

allFdns = collector1.OfCategory(BuiltInCategory.OST_StructuralFoundation).WhereElementIsNotElementType().ToElements()
allCols = collector2.OfCategory(BuiltInCategory.OST_StructuralColumns).WhereElementIsNotElementType().ToElements()
allBeams = collector3.OfCategory(BuiltInCategory.OST_StructuralFraming).WhereElementIsNotElementType().ToElements()
allFloors = collector4.OfCategory(BuiltInCategory.OST_Floors).WhereElementIsNotElementType().ToElements()
_allEdges = collector5.OfCategory(BuiltInCategory.OST_EdgeSlab).WhereElementIsNotElementType().ToElements()
allIsoFdns = [i.ToDSType(False) for i in allFdns if "Footing-" in i.Name]
allPeds = [i.ToDSType(False) for i in allCols if "UG" in i.Name]
allPedsGeo = [i.Geometry()[0] for i in allPeds]
allTGs = [i.ToDSType(False) for i in allBeams if "TG" in i.Name]
allTGsGeo = [i.Geometry()[0] for i in allTGs]
allSOGs = [i.ToDSType(False) for i in allFdns if "SOG" in i.Name and "GS" in i.Name]
allSOGsGeo = [i.Geometry()[0] for i in allSOGs]
allEdges = [i.ToDSType(False) for i in _allEdges]
allEdgesGeo = [i.Geometry()[0] for i in allEdges]
allFdnAndHaunch = [i.ToDSType(False) for i in allFdns+_allEdges]
allFdnAndHaunchGeo = list(chain(*[i.Geometry() for i in allFdnAndHaunch]))
#allFdnAndHaunchGeo = [i.Geometry()[0] for i in allFdnAndHaunch]
# The inputs to this node will be stored as a list in the IN variables.
dataEnteringNode = IN
inputs = IN[0]
# Place your code below this line
def 하드너물량산출함수(input):
    if "PAD" in input.Name:
        pass
    
    else:
        inputGeo = input.Geometry()[0]
        상부면 = [i for i in inputGeo.Explode() if round(i.NormalAtParameter(0.5,0.5).Z)==1][0]
        
        target = 상부면
        
        return (target, target.Area/1000000, "M2")

# Assign your output to the OUT variable.
OUT = (하드너물량산출함수,["GS"],[": Hardener"],["M2"])
# ----------------------------------------
콘크리트물량산출함수_2 = Python()  # CPython3; unwired: IN[0]
# ---------- 콘크리트물량산출함수_2.python (65 lines) ----------
# Load the Python Standard and DesignScript Libraries
import sys
import clr
clr.AddReference('RevitAPI')
from Autodesk.Revit.DB import *
import Autodesk

clr.AddReference('RevitNodes')
import Revit
clr.ImportExtensions(Revit.Elements)

clr.AddReference('RevitServices')
import RevitServices
from RevitServices.Persistence import DocumentManager
doc = DocumentManager.Instance.CurrentDBDocument
collector1 = FilteredElementCollector(doc)
collector2 = FilteredElementCollector(doc)
collector3 = FilteredElementCollector(doc)
collector4 = FilteredElementCollector(doc)
collector5 = FilteredElementCollector(doc)

clr.AddReference('ProtoGeometry')
from Autodesk.DesignScript.Geometry import *

from itertools import chain

allFdns = collector1.OfCategory(BuiltInCategory.OST_StructuralFoundation).WhereElementIsNotElementType().ToElements()
allCols = collector2.OfCategory(BuiltInCategory.OST_StructuralColumns).WhereElementIsNotElementType().ToElements()
allBeams = collector3.OfCategory(BuiltInCategory.OST_StructuralFraming).WhereElementIsNotElementType().ToElements()
allFloors = collector4.OfCategory(BuiltInCategory.OST_Floors).WhereElementIsNotElementType().ToElements()
_allEdges = collector5.OfCategory(BuiltInCategory.OST_EdgeSlab).WhereElementIsNotElementType().ToElements()
allIsoFdns = [i.ToDSType(False) for i in allFdns if "Footing-" in i.Name]
allPeds = [i.ToDSType(False) for i in allCols if "UG" in i.Name]
allPedsGeo = [i.Geometry()[0] for i in allPeds]
allTGs = [i.ToDSType(False) for i in allBeams if "TG" in i.Name]
allTGsGeo = [i.Geometry()[0] for i in allTGs]
allSOGs = [i.ToDSType(False) for i in allFdns if "SOG" in i.Name and "GS" in i.Name]
allSOGsGeo = [i.Geometry()[0] for i in allSOGs]
allEdges = [i.ToDSType(False) for i in _allEdges]
allEdgesGeo = [i.Geometry()[0] for i in allEdges]
allFdnAndHaunch = [i.ToDSType(False) for i in allFdns+_allEdges]
allFdnAndHaunchGeo = list(chain(*[i.Geometry() for i in allFdnAndHaunch]))
#allFdnAndHaunchGeo = [i.Geometry()[0] for i in allFdnAndHaunch]
# The inputs to this node will be stored as a list in the IN variables.
dataEnteringNode = IN
inputs = IN[0]
# Place your code below this line
def 콘크리트물량산출함수(input):
    if "Footing-Rectangular" in input.Name:
        target = input
        
        return (target.Geometry()[0], target.GetParameterValueByName("Volume"), "M3")
    
    elif "SOG" in input.Name:
        inputGeo = input.Geometry()[0]
        간섭판별선 = PolyCurve.ByJoinedCurves([i for i in inputGeo.Explode() if round(i.NormalAtParameter(0.5,0.5).Z)==-1][0].PerimeterCurves()).Offset(-1)
        간섭판별면 = 간섭판별선.Patch()
        overlaps = [i for i in allEdgesGeo if 간섭판별면.DoesIntersect(i)]+[inputGeo]
        unionSolid = Solid.ByUnion(overlaps)
        target = unionSolid
        
        return (target, target.Volume/1000000000, "M3")

# Assign your output to the OUT variable.
OUT = (콘크리트물량산출함수,["Footing-Rectangular","SOG"],[": Structural Concrete"],["M3"])
# ----------------------------------------
독립기초철근비_2 = DoubleInput(0.1)  # graph input
슬라브철근비_2 = DoubleInput(0.15)  # graph input
패드철근비_2 = DoubleInput(0.1)  # graph input
철근물량산출함수_2 = Python(IN[0]=콘크리트물량산출함수_2, IN[2]=독립기초철근비_2, IN[3]=슬라브철근비_2, IN[4]=패드철근비_2)  # CPython3; unwired: IN[1]
# ---------- 철근물량산출함수_2.python (75 lines) ----------
# Load the Python Standard and DesignScript Libraries
import sys
import clr
clr.AddReference('RevitAPI')
from Autodesk.Revit.DB import *
import Autodesk

clr.AddReference('RevitNodes')
import Revit
clr.ImportExtensions(Revit.Elements)

clr.AddReference('RevitServices')
import RevitServices
from RevitServices.Persistence import DocumentManager
doc = DocumentManager.Instance.CurrentDBDocument
collector1 = FilteredElementCollector(doc)
collector2 = FilteredElementCollector(doc)
collector3 = FilteredElementCollector(doc)
collector4 = FilteredElementCollector(doc)
collector5 = FilteredElementCollector(doc)

clr.AddReference('ProtoGeometry')
from Autodesk.DesignScript.Geometry import *

from itertools import chain

allFdns = collector1.OfCategory(BuiltInCategory.OST_StructuralFoundation).WhereElementIsNotElementType().ToElements()
allCols = collector2.OfCategory(BuiltInCategory.OST_StructuralColumns).WhereElementIsNotElementType().ToElements()
allBeams = collector3.OfCategory(BuiltInCategory.OST_StructuralFraming).WhereElementIsNotElementType().ToElements()
allFloors = collector4.OfCategory(BuiltInCategory.OST_Floors).WhereElementIsNotElementType().ToElements()
_allEdges = collector5.OfCategory(BuiltInCategory.OST_EdgeSlab).WhereElementIsNotElementType().ToElements()
allIsoFdns = [i.ToDSType(False) for i in allFdns if "Footing-" in i.Name]
allPeds = [i.ToDSType(False) for i in allCols if "UG" in i.Name]
allPedsGeo = [i.Geometry()[0] for i in allPeds]
allTGs = [i.ToDSType(False) for i in allBeams if "TG" in i.Name]
allTGsGeo = [i.Geometry()[0] for i in allTGs]
allSOGs = [i.ToDSType(False) for i in allFdns if "SOG" in i.Name and "GS" in i.Name]
allSOGsGeo = [i.Geometry()[0] for i in allSOGs]
allEdges = [i.ToDSType(False) for i in _allEdges]
allEdgesGeo = [i.Geometry()[0] for i in allEdges]
allFdnAndHaunch = [i.ToDSType(False) for i in allFdns+_allEdges]
allFdnAndHaunchGeo = list(chain(*[i.Geometry() for i in allFdnAndHaunch]))
#allFdnAndHaunchGeo = [i.Geometry()[0] for i in allFdnAndHaunch]
# The inputs to this node will be stored as a list in the IN variables.
dataEnteringNode = IN

refFunc = IN[0][0]
inputs = IN[1]
독립기초철근비 = IN[2]
슬라브철근비 = IN[3]
패드철근비 = IN[4]

# Place your code below this line
def 철근물량산출함수(input):
    콘크리트물량산출함수 = refFunc
    if "Footing-Rectangular" in input.Name:
        target = 콘크리트물량산출함수(input)[0]
        ratio = 독립기초철근비
        
        return ("형상정보 미제공", target.Volume*ratio/1000000000, "TON")
    
    elif "SOG" in input.Name:
        target = 콘크리트물량산출함수(input)[0]
        ratio = 슬라브철근비
        
        return ("형상정보 미제공", target.Volume*ratio/1000000000, "TON")
        
    elif "PAD" in input.Name:
        target = 콘크리트물량산출함수(input)[0]
        ratio = 패드철근비
        
        return ("형상정보 미제공", target.Volume*ratio/1000000000, "TON")

# Assign your output to the OUT variable.
OUT = (철근물량산출함수,["Footing-Rectangular","SOG"],["Rebar Work"],["TON"])
# ----------------------------------------
콘크리트물량산출함수_패드 = Python()  # CPython3; unwired: IN[0]
# ---------- 콘크리트물량산출함수_패드.python (65 lines) ----------
# Load the Python Standard and DesignScript Libraries
import sys
import clr
clr.AddReference('RevitAPI')
from Autodesk.Revit.DB import *
import Autodesk

clr.AddReference('RevitNodes')
import Revit
clr.ImportExtensions(Revit.Elements)

clr.AddReference('RevitServices')
import RevitServices
from RevitServices.Persistence import DocumentManager
doc = DocumentManager.Instance.CurrentDBDocument
collector1 = FilteredElementCollector(doc)
collector2 = FilteredElementCollector(doc)
collector3 = FilteredElementCollector(doc)
collector4 = FilteredElementCollector(doc)
collector5 = FilteredElementCollector(doc)

clr.AddReference('ProtoGeometry')
from Autodesk.DesignScript.Geometry import *

from itertools import chain

allFdns = collector1.OfCategory(BuiltInCategory.OST_StructuralFoundation).WhereElementIsNotElementType().ToElements()
allCols = collector2.OfCategory(BuiltInCategory.OST_StructuralColumns).WhereElementIsNotElementType().ToElements()
allBeams = collector3.OfCategory(BuiltInCategory.OST_StructuralFraming).WhereElementIsNotElementType().ToElements()
allFloors = collector4.OfCategory(BuiltInCategory.OST_Floors).WhereElementIsNotElementType().ToElements()
_allEdges = collector5.OfCategory(BuiltInCategory.OST_EdgeSlab).WhereElementIsNotElementType().ToElements()
allIsoFdns = [i.ToDSType(False) for i in allFdns if "Footing-" in i.Name]
allPeds = [i.ToDSType(False) for i in allCols if "UG" in i.Name]
allPedsGeo = [i.Geometry()[0] for i in allPeds]
allTGs = [i.ToDSType(False) for i in allBeams if "TG" in i.Name]
allTGsGeo = [i.Geometry()[0] for i in allTGs]
allSOGs = [i.ToDSType(False) for i in allFdns if "SOG" in i.Name and "GS" in i.Name]
allSOGsGeo = [i.Geometry()[0] for i in allSOGs]
allEdges = [i.ToDSType(False) for i in _allEdges]
allEdgesGeo = [i.Geometry()[0] for i in allEdges]
allFdnAndHaunch = [i.ToDSType(False) for i in allFdns+_allEdges]
allFdnAndHaunchGeo = list(chain(*[i.Geometry() for i in allFdnAndHaunch]))
#allFdnAndHaunchGeo = [i.Geometry()[0] for i in allFdnAndHaunch]
# The inputs to this node will be stored as a list in the IN variables.
dataEnteringNode = IN
inputs = IN[0]
# Place your code below this line
def 콘크리트물량산출함수_패드(input):
    if "Footing-Rectangular" in input.Name:
        target = input
        
        return (target.Geometry()[0], target.GetParameterValueByName("Volume"), "M3")
    
    elif "SOG" in input.Name:
        inputGeo = input.Geometry()[0]
        간섭판별선 = PolyCurve.ByJoinedCurves([i for i in inputGeo.Explode() if round(i.NormalAtParameter(0.5,0.5).Z)==-1][0].PerimeterCurves()).Offset(-1)
        간섭판별면 = 간섭판별선.Patch()
        overlaps = [i for i in allEdgesGeo if 간섭판별면.DoesIntersect(i)]+[inputGeo]
        unionSolid = Solid.ByUnion(overlaps)
        target = unionSolid
        
        return (target, target.Volume/1000000000, "M3")

# Assign your output to the OUT variable.
OUT = (콘크리트물량산출함수_패드,["PAD"],[": Structural Concrete"],["M3"])
# ----------------------------------------
거푸집산출함수_2 = Python()  # CPython3; unwired: IN[0]
# ---------- 거푸집산출함수_2.python (35 lines) ----------
# Load the Python Standard and DesignScript Libraries
import sys
import clr
clr.AddReference('RevitAPI')
from Autodesk.Revit.DB import *
import Autodesk

clr.AddReference('RevitNodes')
import Revit
clr.ImportExtensions(Revit.Elements)

clr.AddReference('RevitServices')
import RevitServices
from RevitServices.Persistence import DocumentManager
doc = DocumentManager.Instance.CurrentDBDocument
collector = FilteredElementCollector(doc)#Autodesk.Revit.DB.FilteredElementCollector(doc)

clr.AddReference('ProtoGeometry')
from Autodesk.DesignScript.Geometry import *

from itertools import chain

# The inputs to this node will be stored as a list in the IN variables.
dataEnteringNode = IN
_inputs = IN[0]
# Place your code below this line
def 거푸집산출함수(input):
    geo = input.Geometry()[0]
    allSrf = geo.Explode()
    sideSrf = [i for i in allSrf if round(i.NormalAtParameter(0.5,0.5).Z)==0]
    
    return (sideSrf, sum([i.Area for i in sideSrf])/1000000, "M2")

# Assign your output to the OUT variable.
OUT = (거푸집산출함수,["Footing-Rectangular"],[": Form"],["M2"])
# ----------------------------------------
온통_터파기_여부_2 = BoolSelector(false)  # graph input
터파기_하부_offset_2 = DoubleInput(300)  # graph input
버림thk_2 = DoubleInput(50)  # graph input
경사_비율_입력_1_x_for_isofdn_2 = DoubleInput(2)  # graph input
터파기산출함수_2 = Python(IN[1]=온통_터파기_여부_2, IN[3]=터파기_하부_offset_2, IN[4]=버림thk_2, IN[5]=경사_비율_입력_1_x_for_isofdn_2)  # CPython3; unwired: IN[0], IN[2]
# ---------- 터파기산출함수_2.python (107 lines) ----------
# Load the Python Standard and DesignScript Libraries
import sys
import clr

clr.AddReference('RevitAPI')
from Autodesk.Revit.DB import *
import Autodesk

clr.AddReference('RevitNodes')
import Revit
clr.ImportExtensions(Revit.Elements)

clr.AddReference('RevitServices')
import RevitServices
from RevitServices.Persistence import DocumentManager
doc = DocumentManager.Instance.CurrentDBDocument
collector1 = FilteredElementCollector(doc)#Autodesk.Revit.DB.FilteredElementCollector(doc)

clr.AddReference('ProtoGeometry')
from Autodesk.DesignScript.Geometry import *

allFdns = collector1.OfCategory(BuiltInCategory.OST_StructuralFoundation).WhereElementIsNotElementType().ToElements()
allIsoFdns = [i.ToDSType(False) for i in allFdns if "Footing-" in i.Name]

# The inputs to this node will be stored as a list in the IN variables.
dataEnteringNode = IN
refFunc = IN[0]
wholeExcavationBln = IN[1]
inputDS = IN[2]
bttmOffset = IN[3]
버림thk = IN[4]
slopeExcav = IN[5]



# Place your code below this line

def 터파기산출함수(input):
    targets = []
    
    if wholeExcavationBln:
        calcTargetNum = len(allIsoFdns)
        fdnsGeo = [i.Geometry()[0] for i in allIsoFdns]
        bdBox_fdn = BoundingBox.ByGeometry(fdnsGeo).ToCuboid()
        srfs = bdBox_fdn.Explode()
        belowSrf = [i for i in srfs if i.NormalAtParameter(0.5,0.5).Z == -1][0]
        def getSrfHeight(srf):
            _crvs = srf.PerimeterCurves()
            heights = [i.StartPoint.Z for i in _crvs]
            height = min(heights)
            return height
        belowSrf_height = getSrfHeight(belowSrf)
        
        def findLeanThk(leanobj):
            if leanobj:
                return leanobj.GetParameterValueByName("thk")
            else:
                return 버림thk
        leanobj = None
        leanthk = findLeanThk(leanobj)
        
        def offsetCrv(crv, offset=300):
            return crv.Offset(offset)
        def correctElev(crv, thk):
            return crv.Translate(0,0,thk)
        _exca_belowbdry = offsetCrv(PolyCurve.ByJoinedCurves(belowSrf.PerimeterCurves()), bttmOffset)
        exca_belowbdry = correctElev(_exca_belowbdry, -버림thk)
        _exca_upperbdry = correctElev(_exca_belowbdry, -belowSrf_height)
        exca_upperbdry = offsetCrv(_exca_upperbdry, -belowSrf_height/slopeExcav)
        target = Solid.ByLoft([exca_belowbdry,exca_upperbdry])#excavation_solid
        
        
    else:
        calcTargetNum = 1
        srfs = input.Geometry()[0].Explode()
        belowSrf = [i for i in srfs if i.NormalAtParameter(0.5,0.5).Z == -1][0]
        
        def getSrfHeight(srf):
            _crvs = srf.PerimeterCurves()
            heights = [i.StartPoint.Z for i in _crvs]
            height = min(heights)
            return height
        belowSrf_height = getSrfHeight(belowSrf)
        
        def findLeanThk(leanobj):
            if leanobj:
                return leanobj.GetParameterValueByName("thk")
            else:
                return 버림thk
        leanobj = None
        leanthk = findLeanThk(leanobj)
        
        def offsetCrv(crv, offset=300):
            return crv.Offset(offset)
        def correctElev(crv, thk):
            return crv.Translate(0,0,thk)
        _exca_belowbdry = offsetCrv(PolyCurve.ByJoinedCurves(belowSrf.PerimeterCurves()), bttmOffset)
        exca_belowbdry = correctElev(_exca_belowbdry, -버림thk)
        _exca_upperbdry = correctElev(_exca_belowbdry, -belowSrf_height)
        exca_upperbdry = offsetCrv(_exca_upperbdry, -belowSrf_height/slopeExcav)
        target = Solid.ByLoft([exca_belowbdry,exca_upperbdry])#excavation_solid

    return (target, sum([i.Volume for i in [target]])/calcTargetNum/1000000000, "M3")

# Assign your output to the OUT variable.
#OUT = fdnsGeo
OUT = (터파기산출함수,["Footing-Rectangular"],["Excavation"],["M3"])
# ----------------------------------------
경사_비율_입력_1_x_for_sog_2 = DoubleInput(4)  # graph input
터파기산출함수__sog = Python(IN[3]=터파기_하부_offset_2, IN[4]=버림thk_2, IN[5]=경사_비율_입력_1_x_for_sog_2)  # CPython3; unwired: IN[0], IN[1], IN[2]
# ---------- 터파기산출함수__sog.python (73 lines) ----------
# Load the Python Standard and DesignScript Libraries
import sys
import clr

clr.AddReference('RevitAPI')
from Autodesk.Revit.DB import *
import Autodesk

clr.AddReference('RevitNodes')
import Revit
clr.ImportExtensions(Revit.Elements)

clr.AddReference('RevitServices')
import RevitServices
from RevitServices.Persistence import DocumentManager
doc = DocumentManager.Instance.CurrentDBDocument
collector1 = FilteredElementCollector(doc)#Autodesk.Revit.DB.FilteredElementCollector(doc)

clr.AddReference('ProtoGeometry')
from Autodesk.DesignScript.Geometry import *

allFdns = collector1.OfCategory(BuiltInCategory.OST_StructuralFoundation).WhereElementIsNotElementType().ToElements()
allIsoFdns = [i.ToDSType(False) for i in allFdns if "Footing-" in i.Name]

# The inputs to this node will be stored as a list in the IN variables.
dataEnteringNode = IN
refFunc = IN[0]
#wholeExcavationBln = IN[1]
inputDS = IN[2]
bttmOffset = IN[3]
버림thk = IN[4]
slopeExcav = IN[5]



# Place your code below this line

def 터파기산출함수SOG(input):
    
    calcTargetNum = 1
    srfs = input.Geometry()[0].Explode()
    belowSrf = [i for i in srfs if i.NormalAtParameter(0.5,0.5).Z == -1][0]
    
    def getSrfHeight(srf):
        _crvs = srf.PerimeterCurves()
        heights = [i.StartPoint.Z for i in _crvs]
        height = min(heights)
        return height
    belowSrf_height = getSrfHeight(belowSrf)
    
    def findLeanThk(leanobj):
        if leanobj:
            return leanobj.GetParameterValueByName("thk")
        else:
            return 버림thk
    leanobj = None
    leanthk = findLeanThk(leanobj)
    
    def offsetCrv(crv, offset=300):
        return crv.Offset(offset)
    def correctElev(crv, thk):
        return crv.Translate(0,0,thk)
    _exca_belowbdry = offsetCrv(PolyCurve.ByJoinedCurves(belowSrf.PerimeterCurves()), bttmOffset)
    exca_belowbdry = correctElev(_exca_belowbdry, -버림thk)
    _exca_upperbdry = correctElev(_exca_belowbdry, -belowSrf_height)
    exca_upperbdry = offsetCrv(_exca_upperbdry, -belowSrf_height/slopeExcav)
    target = Solid.ByLoft([exca_belowbdry,exca_upperbdry])

    return (target, sum([i.Volume for i in [target]])/calcTargetNum/1000000000, "M3")

# Assign your output to the OUT variable.
#OUT = fdnsGeo
OUT = (터파기산출함수SOG,["SOG"],["Excavation"],["M3"])
# ----------------------------------------
되메우기산출함수_2 = Python(IN[0]=터파기산출함수_2, IN[1]=온통_터파기_여부_2)  # CPython3; unwired: IN[2], IN[3], IN[4], IN[5]
# ---------- 되메우기산출함수_2.python (96 lines) ----------
# Load the Python Standard and DesignScript Libraries
import sys
import clr

clr.AddReference('RevitAPI')
from Autodesk.Revit.DB import *
import Autodesk

clr.AddReference('RevitNodes')
import Revit
clr.ImportExtensions(Revit.Elements)

clr.AddReference('RevitServices')
import RevitServices
from RevitServices.Persistence import DocumentManager
doc = DocumentManager.Instance.CurrentDBDocument
collector1 = FilteredElementCollector(doc)
collector2 = FilteredElementCollector(doc)
collector3 = FilteredElementCollector(doc)
collector4 = FilteredElementCollector(doc)

clr.AddReference('ProtoGeometry')
from Autodesk.DesignScript.Geometry import *

allFdns = collector1.OfCategory(BuiltInCategory.OST_StructuralFoundation).WhereElementIsNotElementType().ToElements()
allCols = collector2.OfCategory(BuiltInCategory.OST_StructuralColumns).WhereElementIsNotElementType().ToElements()
allBeams = collector3.OfCategory(BuiltInCategory.OST_StructuralFraming).WhereElementIsNotElementType().ToElements()
allFloors = collector4.OfCategory(BuiltInCategory.OST_Floors).WhereElementIsNotElementType().ToElements()
allIsoFdns = [i.ToDSType(False) for i in allFdns if "Footing-" in i.Name]
allPeds = [i.ToDSType(False) for i in allCols if "UG" in i.Name]
allPedsGeo = [i.Geometry()[0] for i in allPeds]
allTGs = [i.ToDSType(False) for i in allBeams if "TG" in i.Name]
allTGsGeo = [i.Geometry()[0] for i in allTGs]
allSOGs = [i.ToDSType(False) for i in allFdns if "SOG" in i.Name and "GS" in i.Name]
allSOGsGeo = [i.Geometry()[0] for i in allSOGs]

# The inputs to this node will be stored as a list in the IN variables.
dataEnteringNode = IN
refFunc = IN[0][0]
wholeExcavationBln = IN[1]
input = IN[2]
bttmOffset = IN[3]
버림thk = IN[4]
slopeExcav = IN[5]


# Place your code below this line

def 되메우기산출함수(input):
    targets = []
    
    if wholeExcavationBln:
        calcTargetNum = len(allIsoFdns)
        exca_solid = refFunc(input)[0]
        fdn_solid = Solid.ByUnion([i.Geometry()[0] for i in allIsoFdns])
        peds_solid = Solid.ByUnion(allPedsGeo)
        TGs_solid = Solid.ByUnion(allTGsGeo)
        SOGs_solid = Solid.ByUnion(allSOGsGeo)
        _target1 = exca_solid.Difference(fdn_solid)
        _target2 = _target1.Difference(peds_solid)
        _target3 = _target2.Difference(TGs_solid)
        target = _target3.Difference(SOGs_solid)
        pass

    else:
        calcTargetNum = 1
        exca_solid = refFunc(input)[0]
        fdn_solid = input.Geometry()[0]
        _joinedPeds = [i for i in allPedsGeo if i.DoesIntersect(exca_solid)]
        joinedPeds = Solid.ByUnion(_joinedPeds)
        _joinedTGs = [i for i in allTGsGeo if i.DoesIntersect(exca_solid)]
        _joinedSOGs = [i for i in allSOGsGeo if i.DoesIntersect(exca_solid)]
        if len(_joinedTGs)>0:
            joinedTGs = Solid.ByUnion(_joinedTGs)
            _target1 = exca_solid.Difference(fdn_solid)#Backfill_Solid ##린 콘크리트 형상 미포함
            _target2 = _target1.Difference(joinedPeds)
            _target3 = _target2.Difference(joinedTGs)
            if len(_joinedSOGs):
                joinedSOGs = Solid.ByUnion(_joinedTGs)
                target = _target3.Difference(joinedSOGs)
            else:
                target = _target3
        else:
            _target1 = exca_solid.Difference(fdn_solid)
            _target2 = _target1.Difference(joinedPeds)
            if len(_joinedSOGs):
                joinedSOGs = Solid.ByUnion(_joinedTGs)
                target = _target2.Difference(joinedSOGs)
            else:
                target = _target2

    return (target, sum([i.Volume for i in [target]])/calcTargetNum/1000000000, "M3")

# Assign your output to the OUT variable.
#OUT = getBackfillTarget(input)
OUT = (되메우기산출함수,["Footing-Rectangular"],["Backfill"],["M3"])
# ----------------------------------------
토량_환산_계수_2 = DoubleInput(1.2)  # graph input
잔토처리산출함수_2 = Python(IN[0]=터파기산출함수_2, IN[1]=온통_터파기_여부_2, IN[2]=토량_환산_계수_2)  # CPython3; unwired: IN[3], IN[4], IN[5]
# ---------- 잔토처리산출함수_2.python (84 lines) ----------
# Load the Python Standard and DesignScript Libraries
import sys
import clr

clr.AddReference('RevitAPI')
from Autodesk.Revit.DB import *
import Autodesk

clr.AddReference('RevitNodes')
import Revit
clr.ImportExtensions(Revit.Elements)

clr.AddReference('RevitServices')
import RevitServices
from RevitServices.Persistence import DocumentManager
doc = DocumentManager.Instance.CurrentDBDocument
collector1 = FilteredElementCollector(doc)
collector2 = FilteredElementCollector(doc)
collector3 = FilteredElementCollector(doc)
collector4 = FilteredElementCollector(doc)

clr.AddReference('ProtoGeometry')
from Autodesk.DesignScript.Geometry import *

from itertools import chain

allFdns = collector1.OfCategory(BuiltInCategory.OST_StructuralFoundation).WhereElementIsNotElementType().ToElements()
allCols = collector2.OfCategory(BuiltInCategory.OST_StructuralColumns).WhereElementIsNotElementType().ToElements()
allBeams = collector3.OfCategory(BuiltInCategory.OST_StructuralFraming).WhereElementIsNotElementType().ToElements()
allFloors = collector4.OfCategory(BuiltInCategory.OST_Floors).WhereElementIsNotElementType().ToElements()
allIsoFdns = [i.ToDSType(False) for i in allFdns if "Footing-" in i.Name]
allPeds = [i.ToDSType(False) for i in allCols if "UG" in i.Name]
allPedsGeo = [i.Geometry()[0] for i in allPeds]
allTGs = [i.ToDSType(False) for i in allBeams if "TG" in i.Name]
allTGsGeo = [i.Geometry()[0] for i in allTGs]
allSOGs = [i.ToDSType(False) for i in allFdns if "SOG" in i.Name and "GS" in i.Name]
allSOGsGeo = [i.Geometry()[0] for i in allSOGs]

# The inputs to this node will be stored as a list in the IN variables.
dataEnteringNode = IN
refFunc = IN[0][0]
wholeExcavationBln = IN[1]
ratio = IN[2]
#bttmOffset = IN[3]
#leanThk = IN[4]
#slopeExcav = IN[5]


# Place your code below this line

def 잔토처리산출함수(input):
    targets = []
    
    if wholeExcavationBln:
        calcTargetNum = len(allIsoFdns)
        exca_solid = refFunc(input)[0]
        fdn_solid = Solid.ByUnion([i.Geometry()[0] for i in allIsoFdns])
        peds_solid = Solid.ByUnion(allPedsGeo)
        TGs_solid = Solid.ByUnion(allTGsGeo)
        SOGs_solid = Solid.ByUnion(allSOGsGeo)
        _target1 = Solid.ByUnion([fdn_solid,peds_solid,TGs_solid,SOGs_solid])
#        _target1 = exca_solid.Difference(fdn_solid)
#        _target2 = _target1.Difference(peds_solid)
#        _target3 = _target2.Difference(TGs_solid)
        target = _target1.Intersect(exca_solid)[0]
        pass

    else:
        calcTargetNum = 1
        exca_solid = refFunc(input)[0]
        fdn_solid = input.Geometry()[0]
        _joinedPeds = [i for i in allPedsGeo if i.DoesIntersect(exca_solid)]
        #joinedPeds = Solid.ByUnion(_joinedPeds)
        _joinedTGs = [i for i in allTGsGeo if i.DoesIntersect(exca_solid)]
        _joinedSOGs = [i for i in allSOGsGeo if i.DoesIntersect(exca_solid)]
        _target1 = Solid.ByUnion(list(chain(*[[fdn_solid] + _joinedPeds + _joinedTGs + _joinedSOGs])))
        target = _target1.Intersect(exca_solid)[0]


    return (target, sum([i.Volume for i in [target]])*ratio/calcTargetNum/1000000000, "M3")

# Assign your output to the OUT variable.
#OUT = getBackfillTarget(input)
OUT = (잔토처리산출함수,["Footing-Rectangular"],["Disposal"],["M3"])
# ----------------------------------------
기층_thk = DoubleInput(300)  # graph input
기층물량산출함수_2 = Python(IN[0]=터파기산출함수_2, IN[1]=온통_터파기_여부_2, IN[2]=기층_thk, IN[3]=터파기_하부_offset_2, IN[4]=버림thk_2)  # CPython3; unwired: IN[5]
# ---------- 기층물량산출함수_2.python (75 lines) ----------
# Load the Python Standard and DesignScript Libraries
import sys
import clr

clr.AddReference('RevitAPI')
from Autodesk.Revit.DB import *
import Autodesk

clr.AddReference('RevitNodes')
import Revit
clr.ImportExtensions(Revit.Elements)

clr.AddReference('RevitServices')
import RevitServices
from RevitServices.Persistence import DocumentManager
doc = DocumentManager.Instance.CurrentDBDocument
collector1 = FilteredElementCollector(doc)
collector2 = FilteredElementCollector(doc)
collector3 = FilteredElementCollector(doc)
collector4 = FilteredElementCollector(doc)

clr.AddReference('ProtoGeometry')
from Autodesk.DesignScript.Geometry import *

from itertools import chain

allFdns = collector1.OfCategory(BuiltInCategory.OST_StructuralFoundation).WhereElementIsNotElementType().ToElements()
allCols = collector2.OfCategory(BuiltInCategory.OST_StructuralColumns).WhereElementIsNotElementType().ToElements()
allBeams = collector3.OfCategory(BuiltInCategory.OST_StructuralFraming).WhereElementIsNotElementType().ToElements()
allFloors = collector4.OfCategory(BuiltInCategory.OST_Floors).WhereElementIsNotElementType().ToElements()
allIsoFdns = [i.ToDSType(False) for i in allFdns if "Footing-" in i.Name]
allPeds = [i.ToDSType(False) for i in allCols if "UG" in i.Name]
allPedsGeo = [i.Geometry()[0] for i in allPeds]
allTGs = [i.ToDSType(False) for i in allBeams if "TG" in i.Name]
allTGsGeo = [i.Geometry()[0] for i in allTGs]
allSOGs = [i.ToDSType(False) for i in allFdns if "SOG" in i.Name and "GS" in i.Name]
allSOGsGeo = [i.Geometry()[0] for i in allSOGs]

# The inputs to this node will be stored as a list in the IN variables.
dataEnteringNode = IN
refFunc = IN[0][0]
wholeExcavationBln = IN[1]
기층thk = IN[2]
bttmOffset = IN[3]
버림thk = IN[4]
#slopeExcav = IN[5]


# Place your code below this line

def 기층물량산출함수(input):
    targets = []
    
    if wholeExcavationBln:
        calcTargetNum = len(allIsoFdns)
        exca_solid = refFunc(input)[0]
        srfs_exca_blw = [i for i in exca_solid.Explode() if round(i.NormalAtParameter(0.5,0.5).Z)==-1]
        

        target = srfs_exca_blw[0].Translate(0,0,-기층thk)
        pass

    else:
        calcTargetNum = 1
        exca_solid = refFunc(input)[0]
        srfs_exca_blw = [i for i in exca_solid.Explode() if round(i.NormalAtParameter(0.5,0.5).Z)==-1]

        target = srfs_exca_blw[0].Translate(0,0,-기층thk)


    return (target, sum([i.Area for i in [target]])/calcTargetNum/1000000, "M2")

# Assign your output to the OUT variable.
#OUT = getBackfillTarget(input)
OUT = (기층물량산출함수,["Footing-Rectangular"],["Base Course"],["M2"])
# ----------------------------------------
버림offset_2 = DoubleInput(100)  # graph input
버림콘크리트산출함수_2 = Python(IN[4]=버림thk_2, IN[5]=버림offset_2)  # CPython3; unwired: IN[0], IN[1], IN[2], IN[3]
# ---------- 버림콘크리트산출함수_2.python (143 lines) ----------
# Load the Python Standard and DesignScript Libraries
import sys
import clr

clr.AddReference('RevitAPI')
from Autodesk.Revit.DB import *
import Autodesk

clr.AddReference('RevitNodes')
import Revit
clr.ImportExtensions(Revit.Elements)

clr.AddReference('RevitServices')
import RevitServices
from RevitServices.Persistence import DocumentManager
doc = DocumentManager.Instance.CurrentDBDocument
collector1 = FilteredElementCollector(doc)
collector2 = FilteredElementCollector(doc)
collector3 = FilteredElementCollector(doc)
collector4 = FilteredElementCollector(doc)
collector5 = FilteredElementCollector(doc)

clr.AddReference('ProtoGeometry')
from Autodesk.DesignScript.Geometry import *

from itertools import chain

allFdns = collector1.OfCategory(BuiltInCategory.OST_StructuralFoundation).WhereElementIsNotElementType().ToElements()
allCols = collector2.OfCategory(BuiltInCategory.OST_StructuralColumns).WhereElementIsNotElementType().ToElements()
allBeams = collector3.OfCategory(BuiltInCategory.OST_StructuralFraming).WhereElementIsNotElementType().ToElements()
allFloors = collector4.OfCategory(BuiltInCategory.OST_Floors).WhereElementIsNotElementType().ToElements()
_allEdges = collector5.OfCategory(BuiltInCategory.OST_EdgeSlab).WhereElementIsNotElementType().ToElements()
allIsoFdns = [i.ToDSType(False) for i in allFdns if "Footing-" in i.Name]
allPeds = [i.ToDSType(False) for i in allCols if "UG" in i.Name]
allPedsGeo = [i.Geometry()[0] for i in allPeds]
allTGs = [i.ToDSType(False) for i in allBeams if "TG" in i.Name]
allTGsGeo = [i.Geometry()[0] for i in allTGs]
allSOGs = [i.ToDSType(False) for i in allFdns if "SOG" in i.Name and "GS" in i.Name]
allSOGsGeo = [i.Geometry()[0] for i in allSOGs]
allEdges = [i.ToDSType(False) for i in _allEdges]
allEdgesGeo = [i.Geometry()[0] for i in allEdges]
allFdnAndHaunch = [i.ToDSType(False) for i in allFdns+_allEdges]
allFdnAndHaunchGeo = list(chain(*[i.Geometry() for i in allFdnAndHaunch]))
#allFdnAndHaunchGeo = [i.Geometry()[0] for i in allFdnAndHaunch]

# The inputs to this node will be stored as a list in the IN variables.
dataEnteringNode = IN
refFunc = IN[0]
input = IN[1]
기층offset = IN[2]
bttmOffset = IN[3]
버림thk = IN[4]
버림offset = IN[5]
#slopeExcav = IN[5]

def getIdxOfMaximum(list):
    result = []
    maxValue = max(list)
    for i in range(len(list)):
        if list[i]==maxValue:
            result.append(i)
    return result

# Place your code below this line

def 버림콘크리트산출함수(input):
    calcTargetNum = 1
    inputGeo = input.Geometry()[0]
    
    if "Footing-Rectangular" in input.Name:
        srf_fdn_lean = [i for i in inputGeo.Explode() if round(i.NormalAtParameter(0.5,0.5).Z)==-1][0]
        crvs_fdn_lean = srf_fdn_lean.PerimeterCurves()
        crv_fdn_lean = PolyCurve.ByJoinedCurves(crvs_fdn_lean)
        crv_offset = crv_fdn_lean.Offset(버림offset)
        leanSrf = Surface.ByPatch(crv_offset)
        vectorZ = leanSrf.NormalAtParameter(0.5,0.5).Z
        if vectorZ>0:
            target = leanSrf.Thicken(-버림thk, False)
        elif vectorZ<0:
            target = leanSrf.Thicken(버림thk, False)
        
    elif "TG" in input.Name:
        srf_TG_lean = [i for i in inputGeo.Explode() if round(i.NormalAtParameter(0.5,0.5).Z)==-1][0]
        crvs_TG_lean = srf_TG_lean.PerimeterCurves()
        len_crvs_TG = [i.Length for i in crvs_TG_lean]
        idx = getIdxOfMaximum(len_crvs_TG)
        crvs_long = []
        for i in idx:
            crvs_long.append(crvs_TG_lean[i])
        extdSrfs = []
        for i in crvs_long:
            vec = i.NormalAtParameter(0.5)
            i_tr = i.Translate(버림offset,vec)
            extdSrfs.append(Surface.ByLoft([i,i_tr]))
        leanSrf = PolyCurve.ByJoinedCurves([srf_TG_lean]+extdSrfs)
        vectorZ = leanSrf.NormalAtParameter(0.5,0.5).Z
        if vectorZ>0:
            target = leanSrf.Thicken(-버림thk, False)
        elif vectorZ<0:
            target = leanSrf.Thicken(버림thk, False)
        
    elif "SOG" in input.Name:
        inputGeo = input.Geometry()[0]
        간섭판별선 = PolyCurve.ByJoinedCurves([i for i in inputGeo.Explode() if round(i.NormalAtParameter(0.5,0.5).Z)==-1][0].PerimeterCurves()).Offset(-1)
        간섭판별면 = 간섭판별선.Patch()
        overlaps = [i for i in allEdgesGeo if 간섭판별면.DoesIntersect(i)]+[inputGeo]
        unionSolid = Solid.ByUnion(overlaps)
        def findBeneathSrf(srfGroup):
            result = []
            upperSrfs = [i for i in srfGroup if round(i.NormalAtParameter(0.5,0.5).Z) == 1]
            headCrvs = []
            for i in upperSrfs:
                headCrv = PolyCurve.ByJoinedCurves(i.PerimeterCurves())
                headCrvs.append(headCrv)
            for i in srfGroup:
                tmp=[]
                for j in headCrvs:
                    if i.DoesIntersect(j):
                        tmp.append(False)
                    else:
                        tmp.append(True)
                if all(tmp):
                    result.append(i)
            return result
        leanSrf = PolySurface.ByJoinedSurfaces(findBeneathSrf(unionSolid.Explode()))
        vectorZ = leanSrf.NormalAtParameter(0.5,0.5).Z
        if vectorZ>0:
            if len(leanSrf.Surfaces())>1:
                target = Solid.ByUnion([i.Thicken(-버림thk, False) for i in leanSrf.Surfaces()])
            else:
                target = leanSrf.Thicken(-버림thk, False)
        elif vectorZ<0:
            if len(leanSrf.Surfaces())>1:
                target = Solid.ByUnion([i.Thicken(버림thk, False) for i in leanSrf.Surfaces()])
            else:
                target = leanSrf.Thicken(버림thk, False)

    #return target
    return (target, sum([i.Volume for i in [target]])/calcTargetNum/1000000000, "M3")

# Assign your output to the OUT variable.
#OUT = 버림콘크리트산출함수(input)
OUT = (버림콘크리트산출함수,["Footing-Rectangular","TG","SOG"],["Lean Concrete"],["M3"])
# ----------------------------------------
잡석_thk = DoubleInput(100)  # graph input
잡석다짐산출함수_2 = Python(IN[0]=버림콘크리트산출함수_2, IN[2]=잡석_thk)  # CPython3; unwired: IN[1], IN[3], IN[4], IN[5]
# ---------- 잡석다짐산출함수_2.python (79 lines) ----------
# Load the Python Standard and DesignScript Libraries
import sys
import clr

clr.AddReference('RevitAPI')
from Autodesk.Revit.DB import *
import Autodesk

clr.AddReference('RevitNodes')
import Revit
clr.ImportExtensions(Revit.Elements)

clr.AddReference('RevitServices')
import RevitServices
from RevitServices.Persistence import DocumentManager
doc = DocumentManager.Instance.CurrentDBDocument
collector1 = FilteredElementCollector(doc)
collector2 = FilteredElementCollector(doc)
collector3 = FilteredElementCollector(doc)
collector4 = FilteredElementCollector(doc)

clr.AddReference('ProtoGeometry')
from Autodesk.DesignScript.Geometry import *

from itertools import chain

allFdns = collector1.OfCategory(BuiltInCategory.OST_StructuralFoundation).WhereElementIsNotElementType().ToElements()
allCols = collector2.OfCategory(BuiltInCategory.OST_StructuralColumns).WhereElementIsNotElementType().ToElements()
allBeams = collector3.OfCategory(BuiltInCategory.OST_StructuralFraming).WhereElementIsNotElementType().ToElements()
allFloors = collector4.OfCategory(BuiltInCategory.OST_Floors).WhereElementIsNotElementType().ToElements()
allIsoFdns = [i.ToDSType(False) for i in allFdns if "Footing-" in i.Name]
allPeds = [i.ToDSType(False) for i in allCols if "UG" in i.Name]
allPedsGeo = [i.Geometry()[0] for i in allPeds]
allTGs = [i.ToDSType(False) for i in allBeams if "TG" in i.Name]
allTGsGeo = [i.Geometry()[0] for i in allTGs]
allSOGs = [i.ToDSType(False) for i in allFdns if "SOG" in i.Name and "GS" in i.Name]
allSOGsGeo = [i.Geometry()[0] for i in allSOGs]

# The inputs to this node will be stored as a list in the IN variables.
dataEnteringNode = IN
refFunc = IN[0][0]
input = IN[1]
잡석thk = IN[2]
bttmOffset = IN[3]
버림thk = IN[4]
#slopeExcav = IN[5]


# Place your code below this line

def 잡석다짐산출함수(input):
    버림콘크리트산출함수 = refFunc
    if "Footing-Rectangular" in input.Name:
        calcTargetNum = 1
        solid_lean = 버림콘크리트산출함수(input)[0]
        srf_lean_blw = PolySurface.ByJoinedSurfaces([i for i in solid_lean.Explode() if round(i.NormalAtParameter(0.5,0.5).Z)==-1])
    
        vectorZ = srf_lean_blw.NormalAtParameter(0.5,0.5).Z
        if vectorZ>0:
            target = srf_lean_blw.Thicken(-잡석thk, False)
        elif vectorZ<0:
            target = srf_lean_blw.Thicken(잡석thk, False)
    elif "SOG" in input.Name:
        calcTargetNum = 1
        solid_lean = 버림콘크리트산출함수(input)[0]
        srf_lean_blw = [i for i in solid_lean.Explode() if i.NormalAtParameter(0.5,0.5).Z==-1]
    
        vectorZ = PolySurface.ByJoinedSurfaces(srf_lean_blw).NormalAtParameter(0.5,0.5).Z
        if vectorZ>0:
            target = Solid.ByUnion([i.Thicken(-잡석thk, False) for i in srf_lean_blw])
        elif vectorZ<0:
            target = Solid.ByUnion([i.Thicken(잡석thk, False) for i in srf_lean_blw])
        
#    return target
    return (target, sum([i.Volume for i in [target]])/calcTargetNum/1000000000, "M3")

# Assign your output to the OUT variable.
#OUT = 잡석다짐산출함수(input)
OUT = (잡석다짐산출함수,["Footing-Rectangular","SOG"],["Crushed Stone"],["M3"])
# ----------------------------------------
pe시트산출함수 = Python(IN[0]=버림콘크리트산출함수_2, IN[4]=버림thk_2)  # CPython3; unwired: IN[1], IN[2], IN[3], IN[5]
# ---------- pe시트산출함수.python (80 lines) ----------
# Load the Python Standard and DesignScript Libraries
import sys
import clr

clr.AddReference('RevitAPI')
from Autodesk.Revit.DB import *
import Autodesk

clr.AddReference('RevitNodes')
import Revit
clr.ImportExtensions(Revit.Elements)

clr.AddReference('RevitServices')
import RevitServices
from RevitServices.Persistence import DocumentManager
doc = DocumentManager.Instance.CurrentDBDocument
collector1 = FilteredElementCollector(doc)
collector2 = FilteredElementCollector(doc)
collector3 = FilteredElementCollector(doc)
collector4 = FilteredElementCollector(doc)
collector5 = FilteredElementCollector(doc)

clr.AddReference('ProtoGeometry')
from Autodesk.DesignScript.Geometry import *

from itertools import chain

allFdns = collector1.OfCategory(BuiltInCategory.OST_StructuralFoundation).WhereElementIsNotElementType().ToElements()
allCols = collector2.OfCategory(BuiltInCategory.OST_StructuralColumns).WhereElementIsNotElementType().ToElements()
allBeams = collector3.OfCategory(BuiltInCategory.OST_StructuralFraming).WhereElementIsNotElementType().ToElements()
allFloors = collector4.OfCategory(BuiltInCategory.OST_Floors).WhereElementIsNotElementType().ToElements()
_allEdges = collector5.OfCategory(BuiltInCategory.OST_EdgeSlab).WhereElementIsNotElementType().ToElements()
allIsoFdns = [i.ToDSType(False) for i in allFdns if "Footing-" in i.Name]
allPeds = [i.ToDSType(False) for i in allCols if "UG" in i.Name]
allPedsGeo = [i.Geometry()[0] for i in allPeds]
allTGs = [i.ToDSType(False) for i in allBeams if "TG" in i.Name]
allTGsGeo = [i.Geometry()[0] for i in allTGs]
allSOGs = [i.ToDSType(False) for i in allFdns if "SOG" in i.Name and "GS" in i.Name]
allSOGsGeo = [i.Geometry()[0] for i in allSOGs]
allEdges = [i.ToDSType(False) for i in _allEdges]
allEdgesGeo = [i.Geometry()[0] for i in allEdges]
allFdnAndHaunch = [i.ToDSType(False) for i in allFdns+_allEdges]
allFdnAndHaunchGeo = list(chain(*[i.Geometry() for i in allFdnAndHaunch]))
#allFdnAndHaunchGeo = [i.Geometry()[0] for i in allFdnAndHaunch]

# The inputs to this node will be stored as a list in the IN variables.
dataEnteringNode = IN
refFunc = IN[0][0]
input = IN[1]
기층offset = IN[2]
bttmOffset = IN[3]
버림thk = IN[4]
버림offset = IN[5]
#slopeExcav = IN[5]

def getIdxOfMaximum(list):
    result = []
    maxValue = max(list)
    for i in range(len(list)):
        if list[i]==maxValue:
            result.append(i)
    return result

# Place your code below this line

def PE시트산출함수(input):
    calcTargetNum = 1
    inputGeo = input.Geometry()[0]
    버림콘크리트산출함수 = refFunc
    버림형상 = 버림콘크리트산출함수(input)[0]
    #버림상부면 = [i for i in 버림형상.Explode() if round(i.NormalAtParameter(0.5,0.5).Z) == 1][0]
    target = 버림형상


    #return target
    return (target, sum([i.Volume/버림thk for i in [target]])/calcTargetNum/1000000, "M2")

# Assign your output to the OUT variable.
#OUT = PE시트산출함수(input)
OUT = (PE시트산출함수,["Footing-Rectangular","TG","SOG"],["PE Sheet (Vapor"],["M2"])
# ----------------------------------------
시트멤브레인산출함수 = Python(IN[0]=pe시트산출함수)  # CPython3; unwired: IN[1], IN[2], IN[3], IN[4], IN[5]
# ---------- 시트멤브레인산출함수.python (80 lines) ----------
# Load the Python Standard and DesignScript Libraries
import sys
import clr

clr.AddReference('RevitAPI')
from Autodesk.Revit.DB import *
import Autodesk

clr.AddReference('RevitNodes')
import Revit
clr.ImportExtensions(Revit.Elements)

clr.AddReference('RevitServices')
import RevitServices
from RevitServices.Persistence import DocumentManager
doc = DocumentManager.Instance.CurrentDBDocument
collector1 = FilteredElementCollector(doc)
collector2 = FilteredElementCollector(doc)
collector3 = FilteredElementCollector(doc)
collector4 = FilteredElementCollector(doc)
collector5 = FilteredElementCollector(doc)

clr.AddReference('ProtoGeometry')
from Autodesk.DesignScript.Geometry import *

from itertools import chain

allFdns = collector1.OfCategory(BuiltInCategory.OST_StructuralFoundation).WhereElementIsNotElementType().ToElements()
allCols = collector2.OfCategory(BuiltInCategory.OST_StructuralColumns).WhereElementIsNotElementType().ToElements()
allBeams = collector3.OfCategory(BuiltInCategory.OST_StructuralFraming).WhereElementIsNotElementType().ToElements()
allFloors = collector4.OfCategory(BuiltInCategory.OST_Floors).WhereElementIsNotElementType().ToElements()
_allEdges = collector5.OfCategory(BuiltInCategory.OST_EdgeSlab).WhereElementIsNotElementType().ToElements()
allIsoFdns = [i.ToDSType(False) for i in allFdns if "Footing-" in i.Name]
allPeds = [i.ToDSType(False) for i in allCols if "UG" in i.Name]
allPedsGeo = [i.Geometry()[0] for i in allPeds]
allTGs = [i.ToDSType(False) for i in allBeams if "TG" in i.Name]
allTGsGeo = [i.Geometry()[0] for i in allTGs]
allSOGs = [i.ToDSType(False) for i in allFdns if "SOG" in i.Name and "GS" in i.Name]
allSOGsGeo = [i.Geometry()[0] for i in allSOGs]
allEdges = [i.ToDSType(False) for i in _allEdges]
allEdgesGeo = [i.Geometry()[0] for i in allEdges]
allFdnAndHaunch = [i.ToDSType(False) for i in allFdns+_allEdges]
allFdnAndHaunchGeo = list(chain(*[i.Geometry() for i in allFdnAndHaunch]))
#allFdnAndHaunchGeo = [i.Geometry()[0] for i in allFdnAndHaunch]

# The inputs to this node will be stored as a list in the IN variables.
dataEnteringNode = IN
refFunc = IN[0][0]
input = IN[1]
기층offset = IN[2]
bttmOffset = IN[3]
버림thk = IN[4]
버림offset = IN[5]
#slopeExcav = IN[5]

def getIdxOfMaximum(list):
    result = []
    maxValue = max(list)
    for i in range(len(list)):
        if list[i]==maxValue:
            result.append(i)
    return result

# Place your code below this line

def 시트멤브레인산출함수(input):
    PE시트산출함수 = refFunc
    calcTargetNum = 1
    타겟형상 = PE시트산출함수(input)[0]
    타겟값 = PE시트산출함수(input)[1]
    #버림상부면 = [i for i in 버림형상.Explode() if round(i.NormalAtParameter(0.5,0.5).Z) == 1][0]
    target = 타겟값


    #return target
    return ("형상정보 미제공", target, "M2")

# Assign your output to the OUT variable.
#OUT = PE시트산출함수(input)
OUT = (시트멤브레인산출함수,["Footing-Rectangular","SOG"],["Sheet Membrane"],["M2"])
# ----------------------------------------
프로텍션보드산출함수_2 = Python()  # CPython3; unwired: IN[0], IN[1], IN[2], IN[3], IN[4], IN[5]
# ---------- 프로텍션보드산출함수_2.python (68 lines) ----------
# Load the Python Standard and DesignScript Libraries
import sys
import clr

clr.AddReference('RevitAPI')
from Autodesk.Revit.DB import *
import Autodesk

clr.AddReference('RevitNodes')
import Revit
clr.ImportExtensions(Revit.Elements)

clr.AddReference('RevitServices')
import RevitServices
from RevitServices.Persistence import DocumentManager
doc = DocumentManager.Instance.CurrentDBDocument
collector1 = FilteredElementCollector(doc)
collector2 = FilteredElementCollector(doc)
collector3 = FilteredElementCollector(doc)
collector4 = FilteredElementCollector(doc)

clr.AddReference('ProtoGeometry')
from Autodesk.DesignScript.Geometry import *

from itertools import chain

allFdns = collector1.OfCategory(BuiltInCategory.OST_StructuralFoundation).WhereElementIsNotElementType().ToElements()
allCols = collector2.OfCategory(BuiltInCategory.OST_StructuralColumns).WhereElementIsNotElementType().ToElements()
allBeams = collector3.OfCategory(BuiltInCategory.OST_StructuralFraming).WhereElementIsNotElementType().ToElements()
allFloors = collector4.OfCategory(BuiltInCategory.OST_Floors).WhereElementIsNotElementType().ToElements()
allIsoFdns = [i.ToDSType(False) for i in allFdns if "Footing-" in i.Name]
allPeds = [i.ToDSType(False) for i in allCols if "UG" in i.Name]
allPedsGeo = [i.Geometry()[0] for i in allPeds]
allTGs = [i.ToDSType(False) for i in allBeams if "TG" in i.Name]
allTGsGeo = [i.Geometry()[0] for i in allTGs]
allSOGs = [i.ToDSType(False) for i in allFdns if "SOG" in i.Name and "GS" in i.Name]
allSOGsGeo = [i.Geometry()[0] for i in allSOGs]

# The inputs to this node will be stored as a list in the IN variables.
dataEnteringNode = IN
refFunc = IN[0]
input = IN[1]
ratio = IN[2]
#bttmOffset = IN[3]
#leanThk = IN[4]
#slopeExcav = IN[5]


# Place your code below this line

def 프로텍션보드산출함수(input):

    calcTargetNum = 1
    #exca_solid = refFunc(input)[0]
    fdn_solid = input.Geometry()[0]
    _joinedPeds = [i for i in allPedsGeo if i.DoesIntersect(fdn_solid)]
    srf_fdn_upper = [i for i in fdn_solid.Explode() if round(i.NormalAtParameter(0.5,0.5).Z) == 1][0]
    srf_fdn_side = [i for i in fdn_solid.Explode() if round(i.NormalAtParameter(0.5,0.5).Z)==0]
    joinedPeds = Solid.ByUnion(_joinedPeds)
    _target1 = srf_fdn_upper.SubtractFrom(joinedPeds)[0]
    target = srf_fdn_side + [_target1]

    #return target
    return (target, sum([i.Area for i in target])/calcTargetNum/1000000, "M2")

# Assign your output to the OUT variable.
#OUT = 프로텍션보드산출함수(input)
OUT = (프로텍션보드산출함수,["Footing-Rectangular"],["Protection Board"],["M2"])
# ----------------------------------------

# group: 함수 리스트 통합
funcSets_5 = Python(IN[0]=하드너물량산출함수, IN[1]=철근물량산출함수_2, IN[2]=콘크리트물량산출함수_패드, IN[3]=콘크리트물량산출함수_2)  # CPython3; same code as funcSets
funcSets_6 = Python(IN[0]=거푸집산출함수_2, IN[1]=터파기산출함수_2, IN[2]=터파기산출함수__sog, IN[3]=되메우기산출함수_2, IN[4]=잔토처리산출함수_2, IN[5]=기층물량산출함수_2)  # CPython3; same code as funcSets
funcSets_7 = Python(IN[0]=버림콘크리트산출함수_2, IN[1]=잡석다짐산출함수_2, IN[2]=pe시트산출함수, IN[3]=시트멤브레인산출함수, IN[4]=프로텍션보드산출함수_2)  # CPython3; same code as funcSets
join_2 = List.Join(list0=funcSets_5, list1=funcSets_6, list2=funcSets_7)

# group: 시트멤브레인산출함수
stringFromWeb_13 = Python(IN[0]=code_block_12.r)  # CPython3; same code as stringFromWeb_12
code_block_28 = CodeBlock(i=stringFromWeb_13) { i[0]; r=i[1]; }
시트멤브레인산출함수_2 = PythonStringNode(script=code_block_28.out0, IN[0]=PE시트산출함수)  # CPython3; unwired: IN[1], IN[2], IN[3], IN[4], IN[5]

# group: 터파기산출함수
터파기산출함수_3 = PythonStringNode()  # CPython3; unwired: script, IN[0], IN[1], IN[2], IN[3], IN[4], IN[5]
stringFromWeb_14 = Python(IN[0]=code_block_4.out1)  # CPython3; same code as stringFromWeb_5
code_block_29 = CodeBlock(i=stringFromWeb_14) { i[0]; r=i[1]; r["온통터파기_여부"]; r["터파기_하부Offset"]; r["버림thk"]; r["경사비율_IsoFDN"]; }

# group: 단위부재 테스트 용도
code_block_30 = CodeBlock(i=code_block._InputElement) { i[129]; }

터파기산출함수_4 = Python(IN[1]=code_block_30, IN[2]=code_block_29.out2, IN[3]=code_block_29.out3, IN[4]=code_block_29.out4, IN[5]=code_block_29.out5)  # CPython3; unwired: IN[0]
# ---------- 터파기산출함수_4.python (107 lines) ----------
# Load the Python Standard and DesignScript Libraries
import sys
import clr

clr.AddReference('RevitAPI')
from Autodesk.Revit.DB import *
import Autodesk

clr.AddReference('RevitNodes')
import Revit
clr.ImportExtensions(Revit.Elements)

clr.AddReference('RevitServices')
import RevitServices
from RevitServices.Persistence import DocumentManager
doc = DocumentManager.Instance.CurrentDBDocument
collector1 = FilteredElementCollector(doc)#Autodesk.Revit.DB.FilteredElementCollector(doc)

clr.AddReference('ProtoGeometry')
from Autodesk.DesignScript.Geometry import *

allFdns = collector1.OfCategory(BuiltInCategory.OST_StructuralFoundation).WhereElementIsNotElementType().ToElements()
allIsoFdns = [i.ToDSType(False) for i in allFdns if "Footing-" in i.Name]

# The inputs to this node will be stored as a list in the IN variables.
dataEnteringNode = IN
refFunc = IN[0]
input = IN[1]
wholeExcavationBln = IN[2]
bttmOffset = IN[3]
버림thk = IN[4]
slopeExcav = IN[5]



# Place your code below this line

def 터파기산출함수(input):
    targets = []
    
    if wholeExcavationBln:
        calcTargetNum = len(allIsoFdns)
        fdnsGeo = [i.Geometry()[0] for i in allIsoFdns]
        bdBox_fdn = BoundingBox.ByGeometry(fdnsGeo).ToCuboid()
        srfs = bdBox_fdn.Explode()
        belowSrf = [i for i in srfs if i.NormalAtParameter(0.5,0.5).Z == -1][0]
        def getSrfHeight(srf):
            _crvs = srf.PerimeterCurves()
            heights = [i.StartPoint.Z for i in _crvs]
            height = min(heights)
            return height
        belowSrf_height = getSrfHeight(belowSrf)
        
        def findLeanThk(leanobj):
            if leanobj:
                return leanobj.GetParameterValueByName("thk")
            else:
                return 버림thk
        leanobj = None
        leanthk = findLeanThk(leanobj)
        
        def offsetCrv(crv, offset=300):
            return crv.Offset(offset)
        def correctElev(crv, thk):
            return crv.Translate(0,0,thk)
        _exca_belowbdry = offsetCrv(PolyCurve.ByJoinedCurves(belowSrf.PerimeterCurves()), bttmOffset)
        exca_belowbdry = correctElev(_exca_belowbdry, -버림thk)
        _exca_upperbdry = correctElev(_exca_belowbdry, -belowSrf_height)
        exca_upperbdry = offsetCrv(_exca_upperbdry, -belowSrf_height/slopeExcav)
        target = Solid.ByLoft([exca_belowbdry,exca_upperbdry])#excavation_solid
        
        
    else:
        calcTargetNum = 1
        srfs = input.Geometry()[0].Explode()
        belowSrf = [i for i in srfs if i.NormalAtParameter(0.5,0.5).Z == -1][0]
        
        def getSrfHeight(srf):
            _crvs = srf.PerimeterCurves()
            heights = [i.StartPoint.Z for i in _crvs]
            height = min(heights)
            return height
        belowSrf_height = getSrfHeight(belowSrf)
        
        def findLeanThk(leanobj):
            if leanobj:
                return leanobj.GetParameterValueByName("thk")
            else:
                return 버림thk
        leanobj = None
        leanthk = findLeanThk(leanobj)
        
        def offsetCrv(crv, offset=300):
            return crv.Offset(offset)
        def correctElev(crv, thk):
            return crv.Translate(0,0,thk)
        _exca_belowbdry = offsetCrv(PolyCurve.ByJoinedCurves(belowSrf.PerimeterCurves()), bttmOffset)
        exca_belowbdry = correctElev(_exca_belowbdry, -버림thk)
        _exca_upperbdry = correctElev(_exca_belowbdry, -belowSrf_height)
        exca_upperbdry = offsetCrv(_exca_upperbdry, -belowSrf_height/slopeExcav)
        target = Solid.ByLoft([exca_belowbdry,exca_upperbdry])#excavation_solid

    return (target, sum([i.Volume for i in [target]])/calcTargetNum/1000000000, "M3")

# Assign your output to the OUT variable.
OUT = 터파기산출함수(input)
#OUT = (터파기산출함수,["Footing-Rectangular"],["Excavation"],["M3"])
# ----------------------------------------
name = Element.Name(element=code_block_30)
code_block_31 = CodeBlock(i=code_block._InputElement) { i; }
code_block_32 = CodeBlock(i=watch_8) { i[138]; }
code_block_33 = CodeBlock(i=code_block_32) { i[2][3][0]; }
color_palette_5 = ColorPalette({R: 255, G: 105, B: 180, A: 104})
byGeometryColor = Modifiers.GeometryColor.ByGeometryColor(geometry=code_block_33, color=color_palette_5)
