# Dynamo graph 0_Dynamo Practice.dyn (Dynamo 2.11.1.4675)

code_block = CodeBlock { 0..100; }
watch = Watch(code_block)
code_block_2 = CodeBlock { 0..100..#11; }
watch_2 = Watch(code_block_2)
byCoordinates = Point.ByCoordinates(x=watch_2, y=watch_2, z=watch_2, lacing=CrossProduct)
code_block_3 = CodeBlock()
# ---------- code_block_3.designscript (5 lines) ----------
[
2000,
2500,
3000
];
# ----------------------------------------
code_block_4 = CodeBlock()  # same code as code_block_3
code_block_5 = CodeBlock()
# ---------- code_block_5.designscript (5 lines) ----------
[
500,
600,
700
];
# ----------------------------------------
code_block_6 = CodeBlock()
# ---------- code_block_6.designscript (5 lines) ----------
[
"AA00232AD-00001",
"AA00232AD-00002",
"AA00232AD-00003"
];
# ----------------------------------------
byLengths = Cuboid.ByLengths(width=code_block_3, length=code_block_4, height=code_block_5)
area = Solid.Area(solid=byLengths)
volume = Solid.Volume(solid=byLengths)
code_block_7 = CodeBlock(width=code_block_3, length=code_block_4, height=code_block_5, material=code_block_6, solid=byLengths, surfaceArea=area, volume=volume)
# ---------- code_block_7.designscript (9 lines) ----------
{
"Width": width,
"Length": length,
"Height": height,
"Material": material,
"Solid": solid,
"SurfaceArea": surfaceArea/1000000,
"Volume": volume/1000000000
};
# ----------------------------------------
watch_3 = Watch(code_block_7)
components = DesignScript.Builtin.Dictionary.Components(dictionary=watch_3)
transpose = List.Transpose(lists=components.values)
code_block_8 = CodeBlock()  # same code as code_block_3
code_block_9 = CodeBlock()  # same code as code_block_3
code_block_10 = CodeBlock()
# ---------- code_block_10.designscript (5 lines) ----------
[
500,
500,
500
];
# ----------------------------------------
code_block_11 = CodeBlock()  # same code as code_block_6
byLengths_2 = Cuboid.ByLengths(width=code_block_8, length=code_block_9, height=code_block_10)
area_2 = Solid.Area(solid=byLengths_2)
volume_2 = Solid.Volume(solid=byLengths_2)
code_block_12 = CodeBlock(width=code_block_8, length=code_block_9, height=code_block_10, material=code_block_11, solid=byLengths_2, surfaceArea=area_2, volume=volume_2)  # same code as code_block_7
list_create = List.Create(item0=code_block_7, item1=code_block_12)
code_block_13 = CodeBlock(i=list_create) { i[0]; }
code_block_14 = CodeBlock { "Height"; }
valueAtKey = DesignScript.Builtin.Dictionary.ValueAtKey(dictionary=watch_3, key=code_block_14)
code_block_15 = CodeBlock(i=valueAtKey) { i==500; }
code_block_16 = CodeBlock()
# ---------- code_block_16.designscript (5 lines) ----------
[
"FT112",
"FT113",
"FT114"
];
# ----------------------------------------
code_block_17 = CodeBlock()  # same code as code_block_3
code_block_18 = CodeBlock()  # same code as code_block_3
code_block_19 = CodeBlock()  # same code as code_block_5
code_block_20 = CodeBlock()
# ---------- code_block_20.designscript (11 lines) ----------
[
["AA00232AD-00001",
"AA00232AD-00002",
"AA00232AD-00003"],
["AA00232AD-00004",
"AA00232AD-00005",
"AA00232AD-00006"],
["AA00232AD-00007",
"AA00232AD-00008",
"AA00232AD-00009"]
];
# ----------------------------------------
code_block_21 = CodeBlock()
# ---------- code_block_21.designscript (5 lines) ----------
[
"F1",
"F2",
"F3"
];
# ----------------------------------------
number_slider = DoubleSlider(9000, range=0..10000 step 0.1)
number_slider_2 = DoubleSlider(9000, range=0..10000 step 0.1)

# group: 위치입력부
byCoordinates_2 = Point.ByCoordinates(x=number_slider, y=number_slider_2)
code_block_22 = CodeBlock { 0; 6000; }
byCoordinates_3 = Point.ByCoordinates(x=code_block_22.out1)
byCoordinates_4 = Point.ByCoordinates(y=code_block_22.out1)
join = List.Join(list0=byCoordinates_2, list1=byCoordinates_3, list2=byCoordinates_4)

mQ_DataStructureTest1 = Custom[mQ_DataStructureTest1](ElementType=code_block_16, Width=code_block_17, Length=code_block_18, Height=code_block_19, Material=code_block_20, MemberName=code_block_21, Origin=join)
code_block_23 = CodeBlock { "Volume"; }
valueAtKey_2 = DesignScript.Builtin.Dictionary.ValueAtKey(dictionary=mQ_DataStructureTest1, key=code_block_23)
components_2 = DesignScript.Builtin.Dictionary.Components(dictionary=mQ_DataStructureTest1)
transpose_2 = List.Transpose(lists=components_2.values)
code_block_24 = CodeBlock { "MemberName"; }
valueAtKey_3 = DesignScript.Builtin.Dictionary.ValueAtKey(dictionary=mQ_DataStructureTest1, key=code_block_24)
code_block_25 = CodeBlock { "F2"; }
allIndicesOf = List.AllIndicesOf(list=valueAtKey_3, item=code_block_25)
firstItem = List.FirstItem(list=allIndicesOf)
getItemAtIndex = List.GetItemAtIndex(list=transpose_2, index=firstItem)
code_block_26 = CodeBlock(i=transpose_2) { i[0]; }
code_block_27 = CodeBlock()
# ---------- code_block_27.designscript (4 lines) ----------
[
"Location",
"Material"
];
# ----------------------------------------
allIndicesOf_2 = List.AllIndicesOf(list=components_2.keys, item=code_block_27)
getItemAtIndex_2 = List.GetItemAtIndex(list=code_block_26, index=allIndicesOf_2)
