# Dynamo graph 1_Excel Import 시연.dyn (Dynamo 2.10.1.3976)
# packages: Clockwork for Dynamo 2.x 2.3.0

# group: Basic Template for Excel Data Conjugation

# group: Excel Import
file_path = Filename(".\2_(P-현대차CCPP)_2021326_13287.xlsx")
file_from_path = FileObject(path=file_path)
string_from_object = FromObject(object=file_from_path)
code_block = CodeBlock { "BOQ"; "Sheet1"; }
boolean = BoolSelector(false)
python_script_import_excel_by = Python(IN[0]=string_from_object, IN[1]=code_block.out0, IN[2]=boolean)  # "Python Script@Import Excel(By OpenpyXl)"; CPython3
# ---------- python_script_import_excel_by.python (51 lines) ----------
# Load the Python Standard and DesignScript Libraries
import sys
import os
#sys.path.append(r'C:\Users\HEC\AppData\Local\Programs\Python\Python39\Lib\site-packages')
#sys.path.append(r'C:\Users\pjmk0\AppData\Local\Programs\Python\Python39\Lib\site-packages')
sys.path.append(os.getenv('LOCALAPPDATA').replace('\\','\\\\') + r'\Programs\Python\Python39\Lib\site-packages')
import clr
clr.AddReference('ProtoGeometry')
from Autodesk.DesignScript.Geometry import *
from collections import Iterable

def iterable(obj):
    return isinstance(obj, Iterable)


# The inputs to this node will be stored as a list in the IN variables.
dataEnteringNode = IN
PathIn = IN[0]
SheetNameIn = IN[1]
DataOnlyBln = IN[2]

# Place your code below this line
import datetime
import openpyxl

path = (PathIn)
#path = (r'C:\Users\pjmk0\Downloads\MK\mQ\BIM_물량집계 자동화 산출기준표_rC(20210607)_mk_de.xlsx')

wb_obj = openpyxl.load_workbook(path, data_only=DataOnlyBln)
sheet_obj = wb_obj.get_sheet_by_name(SheetNameIn)

m_row = sheet_obj.max_row
m_col = sheet_obj.max_column

listOut = []



for i in range(1, m_row +1):
    listTemp = []
    for j in range(1, m_col + 1):
        cell_obj = sheet_obj.cell(row=i, column=j)
        listTemp.append(cell_obj.value)
        if len(listTemp) == m_col:
            listOut.append(listTemp)
        


# Assign your output to the OUT variable.
OUT = listOut
#OUT = os.getenv('APPDATA')
# ----------------------------------------

# group: Null값 처리
code_block_2 = CodeBlock { " "; }
isNull = Object.IsNull()  # unwired: object
replaceByCondition = Replace(item=python_script_import_excel_by, replaceWith=code_block_2, condition=isNull)

transpose = List.Transpose(lists=replaceByCondition)
watch_total_data_at_column = Watch(transpose)  # "Watch@Total Data At Column Direction"
count = List.Count(list=python_script_import_excel_by@L2)
maximumItem = List.MaximumItem(list=count)

# group: User Input@Column Index
a_integer_slider_input_column = IntegerSlider(1, range=1..500 step 1)  # "[A] Integer Slider@Input Column Index"
code_block_3 = CodeBlock(inputIndex=a_integer_slider_input_column, maxIndex=maximumItem)
# ---------- code_block_3.designscript (13 lines) ----------
inputIndex;
maxIndex;
i=[Imperative]
{
	if (inputIndex > maxIndex)
	{
		return maxIndex;
	}
	else
	{
		return inputIndex;
	}
};
# ----------------------------------------
b_string_input_column_index = StringInput("c")
toNumber = Custom[Character.ToNumber](str=b_string_input_column_index)  # package Clockwork for Dynamo 2.x; Converts an Excel-style character to a number (e.g. A = 1, AA = 27 etc.).
code_block_4 = CodeBlock(inputIndex=toNumber, maxIndex=maximumItem)  # same code as code_block_3
code_block_5 = CodeBlock { true; }
fromNumber = Custom[Character.FromNumber](n=code_block_3.out2, upperCase=code_block_5)  # package Clockwork for Dynamo 2.x; Converts a number into a character (where 1 = A, 2 = B, ... , 27 = AA, 28 = AB etc.).
watch = Watch(fromNumber)

# group: Data At Column Index
code_block_6 = CodeBlock(A=code_block_3.out2, B=code_block_4.out2) { A-1; B-1; }
getItemAtIndex = List.GetItemAtIndex(list=watch_total_data_at_column, index=code_block_6.out1)
watch_2 = Watch(getItemAtIndex)

watch_total_data_at_row = Watch(replaceByCondition)  # "Watch@Total Data At Row Direction"
count_2 = List.Count(list=python_script_import_excel_by)

# group: User Input@Row Index
integer_slider_input_row_index = IntegerSlider(431, range=1..500 step 1)
code_block_7 = CodeBlock(inputIndex=integer_slider_input_row_index, maxIndex=count_2)  # same code as code_block_3
code_block_8 = CodeBlock(i=code_block_7.out2) { i-1; }

# group: Data At Row Index
getItemAtIndex_2 = List.GetItemAtIndex(list=watch_total_data_at_row, index=code_block_8)
watch_3 = Watch(getItemAtIndex_2)

# group: 문자열 처리 구간
code_block_9 = CodeBlock { i[9]; }  # frozen; unwired: i
code_block_10 = CodeBlock { "("; }
code_block_11 = CodeBlock { -1; }
code_block_12 = CodeBlock { 1; }
code_block_13 = CodeBlock { ":"; }

# group: 예외 처리 구간
string_from_object_2 = FromObject(object=code_block_9)
code_block_14 = CodeBlock { "="; }
contains = String.Contains(str=string_from_object_2, searchFor=code_block_14)
if_ = If(test=contains, true=code_block_9, false=code_block_9)

string_from_object_3 = FromObject(object=if_)

# group (continued): 문자열 처리 구간
split = String.Split(str=string_from_object_3, separator0=code_block_10)
lastItem = List.LastItem(list=split)
remove = String.Remove(string=lastItem, startIndex=code_block_11, count=code_block_12)
split_2 = String.Split(str=remove, separator0=code_block_13)

watch_4 = Watch(split_2)
