# Dynamo graph 3_FDNupperSurfaces_example.dyn (Dynamo 2.10.1.3976)

# group: All Element of Foundations
categories = Categories("OST_StructuralFoundation")
all_elements_of_category = ElementsOfCategory(Category=categories)
watch = Watch(all_elements_of_category)

# group: 독립기초 분류
name = Element.Name(element=watch)
code_block = CodeBlock { "FT112"; }
contains = String.Contains(str=name, searchFor=code_block)
filterByBoolMask = List.FilterByBoolMask(list=watch, mask=contains)

# group: 기초 6면 중 상부 면 추출(법선 벡터 판별)
watch_2 = Watch(filterByBoolMask.in)
faces = Element.Faces(element=watch_2)
code_block_2 = CodeBlock { 0.5; }
normalAtParameter = Surface.NormalAtParameter(surface=faces, u=code_block_2, v=code_block_2)
Z = Vector.Z(vector=normalAtParameter)
code_block_3 = CodeBlock(i=Z) { i==1; }
filterByBoolMask_2 = List.FilterByBoolMask(list=faces, mask=code_block_3)
watch_3 = Watch(filterByBoolMask_2.in)

# group: All Element of Columns
categories_2 = Categories("OST_StructuralColumns")
all_elements_of_category_2 = ElementsOfCategory(Category=categories_2)
watch_4 = Watch(all_elements_of_category_2)

# group: UG 부분 Column 분류
code_block_4 = CodeBlock { "Base Level"; }
getParameterValueByName = Element.GetParameterValueByName(element=watch_4, parameterName=code_block_4)
watch_5 = Watch(getParameterValueByName)
elevation = Level.Elevation(level=watch_5)
watch_6 = Watch(elevation)
code_block_5 = CodeBlock(i=watch_6) { i == -1300; }
filterByBoolMask_3 = List.FilterByBoolMask(list=watch_4, mask=code_block_5)

# group: 기둥 6면 중 하부 면 추출(법선 벡터 판별)
watch_7 = Watch(filterByBoolMask_3.in)
faces_2 = Element.Faces(element=watch_7)
code_block_6 = CodeBlock { 0.5; }
normalAtParameter_2 = Surface.NormalAtParameter(surface=faces_2, u=code_block_6, v=code_block_6)
Z_2 = Vector.Z(vector=normalAtParameter_2)
code_block_7 = CodeBlock(i=Z_2) { i==-1; }
filterByBoolMask_4 = List.FilterByBoolMask(list=faces_2, mask=code_block_7)
watch_8 = Watch(filterByBoolMask_4.in)

# group: DoesIntersect 함수로 만나는 Surface 끼리 매칭
flatten = List.Flatten(list=watch_3)
flatten_2 = List.Flatten(list=watch_8)
doesIntersect = Geometry.DoesIntersect(geometry=flatten_2, other=flatten, lacing=CrossProduct)
code_block_8 = CodeBlock { true; }
allIndicesOf = List.AllIndicesOf(list=doesIntersect@L2, item=code_block_8)
getItemAtIndex = List.GetItemAtIndex(list=flatten, index=allIndicesOf)
watch_9 = Watch(flatten_2)

flatten_3 = List.Flatten(list=getItemAtIndex)

# group (continued): DoesIntersect 함수로 만나는 Surface 끼리 매칭
watch_10 = Watch(flatten_3)

# group: 상부면 기둥면적 공제 후 각 area 산출
difference = Surface.Difference(surface=watch_10, others=watch_9)
area = Surface.Area(surface=difference)
flatten_4 = List.Flatten(list=area)
code_block_9 = CodeBlock { 1000000; }
div = flatten_4 / code_block_9

# group: display
geometry = Element.Geometry(element=watch_4)
color_palette = ColorPalette({R: 217, G: 158, B: 80, A: 123})
byGeometryColor = Modifiers.GeometryColor.ByGeometryColor(geometry=geometry, color=color_palette)

# group: display
geometry_2 = Element.Geometry(element=filterByBoolMask_3.in)
color_palette_2 = ColorPalette({R: 165, G: 42, B: 42, A: 125})
byGeometryColor_2 = Modifiers.GeometryColor.ByGeometryColor(geometry=geometry_2, color=color_palette_2)

# group: display
geometry_3 = Element.Geometry()  # unwired: element
color_palette_3 = ColorPalette({R: 0, G: 0, B: 0, A: 255})
byGeometryColor_3 = Modifiers.GeometryColor.ByGeometryColor(geometry=watch_8, color=color_palette_3)

# group: display
geometry_4 = Element.Geometry(element=watch)
color_palette_4 = ColorPalette({R: 138, G: 43, B: 226, A: 120})
byGeometryColor_4 = Modifiers.GeometryColor.ByGeometryColor(geometry=geometry_4, color=color_palette_4)

# group: display
geometry_5 = Element.Geometry(element=filterByBoolMask.in)
color_palette_5 = ColorPalette({R: 255, G: 0, B: 255, A: 117})
byGeometryColor_5 = Modifiers.GeometryColor.ByGeometryColor(geometry=geometry_5, color=color_palette_5)

# group: display
geometry_6 = Element.Geometry()  # unwired: element
color_palette_6 = ColorPalette({R: 255, G: 0, B: 255, A: 117})
byGeometryColor_6 = Modifiers.GeometryColor.ByGeometryColor(geometry=watch_3, color=color_palette_6)

# group: display
geometry_7 = Element.Geometry()  # unwired: element
color_palette_7 = ColorPalette({R: 0, G: 255, B: 0, A: 116})
byGeometryColor_7 = Modifiers.GeometryColor.ByGeometryColor(geometry=difference, color=color_palette_7)
