# Dynamo graph GenerativeSample_20210713.dyn (Dynamo 2.10.1.3976)
# packages: GenerativeDesign 1.7.3.0

# group: 사이즈 속성 부여 구간
width = DoubleSlider(340, range=50..500 step 1)  # graph input
length = DoubleSlider(347, range=50..800 step 1)  # graph input
byWidthLength = Rectangle.ByWidthLength(width=width, length=length)

# group: Grid Point Setting
code_block = CodeBlock { 0..500..20; }
byCoordinates = Point.ByCoordinates(x=code_block, y=code_block, lacing=CrossProduct)

flatten = List.Flatten(list=byCoordinates)

# group: Boundary Setting
categories = Categories("OST_Lines")
all_elements_of_category = ElementsOfCategory(Category=categories)
geometry = Element.Geometry(element=all_elements_of_category)

remember = Data.Remember(geometry)

# group: Boundary Area
flatten_2 = List.Flatten(list=remember)
byJoinedCurves = PolyCurve.ByJoinedCurves(curves=flatten_2)
byPatch = Surface.ByPatch(closedCurve=byJoinedCurves)

doesIntersect = Geometry.DoesIntersect(geometry=flatten, other=byPatch)
filterByBoolMask = List.FilterByBoolMask(list=flatten, mask=doesIntersect)

# group: 위치 랜덤 부여 구간
flatten_3 = List.Flatten(list=filterByBoolMask.in)
shuffle = List.Shuffle(list=flatten_3)

integer_slider = IntegerSlider64Bit(235, range=0..242 step 1)
getItemAtIndex = List.GetItemAtIndex(list=shuffle, index=integer_slider)

# group (continued): 위치 랜덤 부여 구간
X = Point.X(point=getItemAtIndex)
Y = Point.Y(point=getItemAtIndex)
translate = Geometry.Translate(geometry=byWidthLength, xTranslation=X, yTranslation=Y)

# group: 중점 추출
byPatch_2 = Surface.ByPatch(closedCurve=translate)
code_block_2 = CodeBlock { 0.5; }
pointAtParameter = Surface.PointAtParameter(surface=byPatch_2, u=code_block_2, v=code_block_2)

# group: 회전 속성 부여 구간
ZAxis = Vector.ZAxis()
rotation_angle = IntegerSlider64Bit(40, range=0..180 step 1)  # graph input
rotate = Geometry.Rotate(geometry=translate, origin=pointAtParameter, axis=ZAxis, degrees=rotation_angle)

byPatch_3 = Surface.ByPatch(closedCurve=rotate)
intersect = Geometry.Intersect(geometry=byPatch_3, other=byPatch)
area = Surface.Area(surface=intersect)
intersect_area = List.FirstItem(list=area)  # graph output
perimeterCurves = Surface.PerimeterCurves(surface=intersect)
byJoinedCurves_2 = PolyCurve.ByJoinedCurves(curves=perimeterCurves)
reverse = Curve.Reverse(curve=byJoinedCurves_2)
height = DoubleSlider(224, range=50..300 step 1)  # graph input
extrudeAsSolid = Curve.ExtrudeAsSolid(curve=reverse, distance=height)
volume = Solid.Volume(solid=extrudeAsSolid)
solid_volume = List.FirstItem(list=volume)  # graph output
code_block_3 = CodeBlock { 70; }
byARGB = Color.ByARGB(a=code_block_3, r=code_block_3)
byGeometryColor = Modifiers.GeometryColor.ByGeometryColor(geometry=extrudeAsSolid, color=byARGB)
