# Dynamo graph Str Foundation Calculator_DataStructureTest(0809).dyn (Dynamo 2.10.1.3976)

# group: Example
code_block = CodeBlock { ["a","b","c"]; [1,2,3]; }
byKeysValues = DesignScript.Builtin.Dictionary.ByKeysValues(keys=code_block.out0, values=code_block.out1)
code_block_2 = CodeBlock { ["d","e","f"]; [4,5,6]; }
byKeysValues_2 = DesignScript.Builtin.Dictionary.ByKeysValues(keys=code_block_2.out0, values=code_block_2.out1)
code_block_3 = CodeBlock(a1=byKeysValues, b1=byKeysValues_2)
# ---------- code_block_3.designscript (4 lines) ----------
{
"a1": a1
,"b1": b1
};
# ----------------------------------------
code_block_4 = CodeBlock { "a1"; }
valueAtKey = DesignScript.Builtin.Dictionary.ValueAtKey(dictionary=code_block_3, key=code_block_4)
code_block_5 = CodeBlock { "a"; }
valueAtKey_2 = DesignScript.Builtin.Dictionary.ValueAtKey(dictionary=valueAtKey, key=code_block_5)

# group: Primary Input
categories = Categories("OST_StructuralFoundation")
all_elements_of_category = ElementsOfCategory(Category=categories)
file_path = Filename(".\BIM_물량집계 자동화 산출기준표_rC(20210809).xlsx")
file_from_path = FileObject(path=file_path)
code_block_6 = CodeBlock { "Str Foundations"; }

# group: 0. GetFull WMCodeDescription PerElement
getFullWMCodeDescriptionPerElement = Custom[GetFullWMCodeDescriptionPerElement](InputElement=all_elements_of_category, InputFilePath=file_from_path, InputSheetName=code_block_6)  # GetFullWMCodeDescriptionPerElement

# group: 1. Organize All Element Inform As Dictionary
organizeAllElementInformAsDictionary = Custom[OrganizeAllElementInformAsDictionary](InputDic=getFullWMCodeDescriptionPerElement.Dictionary)  # OrganizeAllElementInformAsDictionary

# group: 2. Select Target Family Element And Connected WorkMasters
code_block_7 = CodeBlock { 0; }
selectTargetFamilyInformAsDictionary = Custom[SelectTargetFamilyInformAsDictionary](InputDic=organizeAllElementInformAsDictionary, InputIndex=code_block_7)  # Select Target Family Element And Connected WorkMasters

# group: Distributer
code_block_8 = CodeBlock(i=selectTargetFamilyInformAsDictionary) { i; }
code_block_9 = CodeBlock(i=code_block_8) { i; }
code_block_10 = CodeBlock(i=code_block_9) { i; }
code_block_11 = CodeBlock(i=code_block_9) { i; }
code_block_12 = CodeBlock(i=code_block_9) { i; }
code_block_13 = CodeBlock(i=code_block_8) { i; }
code_block_14 = CodeBlock(i=code_block_13) { i; }
code_block_15 = CodeBlock(i=code_block_13) { i; }
code_block_16 = CodeBlock(i=code_block_9) { i; }
code_block_17 = CodeBlock(i=code_block_13) { i; }
code_block_18 = CodeBlock(i=code_block_13) { i; }

# group: <Func 4>A01ZZ005: BASE COURSE
code_block_19 = CodeBlock { "TargetElements"; }
valueAtKey_3 = DesignScript.Builtin.Dictionary.ValueAtKey(dictionary=code_block_10, key=code_block_19)
# note: <Func>
createBaseCourseSurfaces = Custom[CreateBaseCourseSurfaces](Element=valueAtKey_3)  # CreateBaseCourseSurfaces
area = Surface.Area(surface=createBaseCourseSurfaces.Surface)
code_block_20 = CodeBlock(i=area) { Math.Round(List.Flatten(i)/1000000, 2); }
code_block_21 = CodeBlock { "M2"; }
count = List.Count(list=code_block_20)
ofRepeatedItem = List.OfRepeatedItem(item=code_block_21, amount=count)
code_block_22 = CodeBlock(FuncValues=code_block_20, FuncValuesUnit=ofRepeatedItem)
# ---------- code_block_22.designscript (4 lines) ----------
{
"FuncValues": _FuncValues,
"FuncValuesUnit": _FuncValuesUnit
};
# ----------------------------------------

# group: <Func 1>A01ZZ001: EXCAVATION
code_block_23 = CodeBlock { "TargetElements"; }
valueAtKey_4 = DesignScript.Builtin.Dictionary.ValueAtKey(dictionary=code_block_11, key=code_block_23)
# note: <Func>
createExcavationSolid = Custom[CreateExcavationSolid](Element=valueAtKey_4)  # CreateExcavationSolidForISOFDN
volume = Solid.Volume(solid=createExcavationSolid.Solid)
code_block_24 = CodeBlock(i=volume) { Math.Round(List.Flatten(i)/1000000000, 2); }
code_block_25 = CodeBlock { "M3"; }
count_2 = List.Count(list=code_block_24)
ofRepeatedItem_2 = List.OfRepeatedItem(item=code_block_25, amount=count_2)
code_block_26 = CodeBlock(FuncValues=code_block_24, FuncValuesUnit=ofRepeatedItem_2)  # same code as code_block_22

# group: <Func 5>A03AC034: LEAN CONCRETE
code_block_27 = CodeBlock { "TargetElements"; }
valueAtKey_5 = DesignScript.Builtin.Dictionary.ValueAtKey(dictionary=code_block_12, key=code_block_27)
# note: <Func>
createLeanConcrete = Custom[CreateLeanConcrete](Element=valueAtKey_5)  # CreateLeanConcreteForISOFDN
volume_2 = Solid.Volume(solid=createLeanConcrete.Solid)
code_block_28 = CodeBlock(i=volume_2) { Math.Round(List.Flatten(i)/1000000000, 2); }
code_block_29 = CodeBlock { "M3"; }
count_3 = List.Count(list=code_block_28)
ofRepeatedItem_3 = List.OfRepeatedItem(item=code_block_29, amount=count_3)
code_block_30 = CodeBlock(FuncValues=code_block_28, FuncValuesUnit=ofRepeatedItem_3)  # same code as code_block_22

# group: <Func 6>A03AC035: FORM WORK
code_block_31 = CodeBlock { "TargetElements"; }
valueAtKey_6 = DesignScript.Builtin.Dictionary.ValueAtKey(dictionary=code_block_14, key=code_block_31)
# note: <Func>
extractSideFacesOfElement = Custom[ExtractSideFacesOfElement](Element=valueAtKey_6)  # ExtractSideFacesOfElement
area_2 = Surface.Area(surface=extractSideFacesOfElement.Surface)
sum = Math.Sum(values=area_2)
code_block_32 = CodeBlock(i=sum) { Math.Round(List.Flatten(i)/1000000, 2); }
code_block_33 = CodeBlock { "M2"; }
count_4 = List.Count(list=code_block_32)
ofRepeatedItem_4 = List.OfRepeatedItem(item=code_block_33, amount=count_4)
code_block_34 = CodeBlock(FuncValues=code_block_32, FuncValuesUnit=ofRepeatedItem_4)  # same code as code_block_22

# group: <Func 9>A03AE060: MEMBRANE PROTECTION BOARD
code_block_35 = CodeBlock { "TargetElements"; }
# note: <Func>
valueAtKey_7 = DesignScript.Builtin.Dictionary.ValueAtKey(dictionary=code_block_15, key=code_block_35)
code_block_36 = CodeBlock { "M2"; }

code_block_37 = CodeBlock(Element=valueAtKey_7) { _Element; }
extractUpperFacesOfElement = Custom[ExtractUpperFacesOfElement](Element=code_block_37)  # ExtractUpperFacesOfElement
flatten = List.Flatten(list=extractUpperFacesOfElement.Surface)
getJoinedElements = Element.GetJoinedElements(element=code_block_37)
flatten_2 = List.Flatten(list=getJoinedElements)
extractBelowFacesOfElement = Custom[ExtractBelowFacesOfElement](Element=flatten_2)  # ExtractBelowFacesOfElement
flatten_3 = List.Flatten(list=extractBelowFacesOfElement.Surface)
doesIntersect = Geometry.DoesIntersect(geometry=flatten_3, other=flatten, lacing=CrossProduct)
code_block_38 = CodeBlock { true; }
allIndicesOf = List.AllIndicesOf(list=doesIntersect@L2, item=code_block_38)
flatten_4 = List.Flatten(list=allIndicesOf)
groupByKey = List.GroupByKey(list=flatten_3, keys=flatten_4)
difference = Surface.Difference(surface=flatten, others=groupByKey.groups)
extractSideFacesOfElement_2 = Custom[ExtractSideFacesOfElement](Element=code_block_37)
addItemToFront = List.AddItemToFront(item=difference@L1, list=extractSideFacesOfElement_2.Surface@L2)
color_palette = ColorPalette({R: 30, G: 144, B: 255, A: 129})
byGeometryColor = Modifiers.GeometryColor.ByGeometryColor(geometry=addItemToFront, color=color_palette)

# group: See Result
code_block_39 = CodeBlock(SeeResult=createBaseCourseSurfaces.GeometryColor) { SeeResult; }
code_block_40 = CodeBlock(SeeResult=createExcavationSolid.GeometryColor) { SeeResult; }
code_block_41 = CodeBlock(SeeResult=createLeanConcrete.GeometryColor) { SeeResult; }
code_block_42 = CodeBlock(SeeResult=extractSideFacesOfElement.GeometryColor) { SeeResult; }
code_block_43 = CodeBlock(SeeResult=byGeometryColor) { SeeResult; }

# group: 2. Select Target Family Element And Connected WorkMasters
code_block_44 = CodeBlock { 1; }
selectTargetFamilyInformAsDictionary_2 = Custom[SelectTargetFamilyInformAsDictionary](InputDic=organizeAllElementInformAsDictionary, InputIndex=code_block_44)

# group: Distributer
code_block_45 = CodeBlock(i=selectTargetFamilyInformAsDictionary_2) { i; }
code_block_46 = CodeBlock(i=code_block_45) { i; }
code_block_47 = CodeBlock(i=code_block_46) { i; }
code_block_48 = CodeBlock(i=code_block_46) { i; }
code_block_49 = CodeBlock(i=code_block_45) { i; }
code_block_50 = CodeBlock(i=code_block_49) { i; }
code_block_51 = CodeBlock(i=code_block_45) { i; }
code_block_52 = CodeBlock(i=code_block_51) { i; }
code_block_53 = CodeBlock(i=code_block_45) { i; }
code_block_54 = CodeBlock(i=code_block_53) { i; }
code_block_55 = CodeBlock(i=code_block_46) { i; }
code_block_56 = CodeBlock(i=code_block_51) { i; }
code_block_57 = CodeBlock(i=code_block_51) { i; }
code_block_58 = CodeBlock(i=code_block_53) { i; }
code_block_59 = CodeBlock(i=code_block_53) { i; }
code_block_60 = CodeBlock(i=code_block_49) { i; }

code_block_61 = CodeBlock { "TargetElements"; }
valueAtKey_8 = DesignScript.Builtin.Dictionary.ValueAtKey(dictionary=code_block_47, key=code_block_61)
# note: <Func>
extractUpperFacesOfElement_2 = Custom[ExtractUpperFacesOfElement](Element=valueAtKey_8)

# group: <Func 2> - 수정필요
code_block_62 = CodeBlock { "TargetElements"; }
valueAtKey_9 = DesignScript.Builtin.Dictionary.ValueAtKey(dictionary=code_block_48, key=code_block_62)
# note: <Func>
extractSideFacesOfElement_3 = Custom[ExtractSideFacesOfElement](Element=valueAtKey_9)
area_3 = Surface.Area(surface=extractSideFacesOfElement_3.Surface)
sum_2 = Math.Sum(values=area_3)
code_block_63 = CodeBlock(i=sum_2) { Math.Round(List.Flatten(i)/1000000, 2); }
code_block_64 = CodeBlock { "M2"; }
count_5 = List.Count(list=code_block_63)
ofRepeatedItem_5 = List.OfRepeatedItem(item=code_block_64, amount=count_5)
code_block_65 = CodeBlock(FuncValues=code_block_63, FuncValuesUnit=ofRepeatedItem_5)  # same code as code_block_22

code_block_66 = CodeBlock { "TargetElements"; }
valueAtKey_10 = DesignScript.Builtin.Dictionary.ValueAtKey(dictionary=code_block_50, key=code_block_66)
code_block_67 = CodeBlock { 0; 100; }
createLeanConcrete_2 = Custom[CreateLeanConcrete](Element=valueAtKey_10, leanOffset=code_block_67.out0, leanThick=code_block_67.out1)
code_block_68 = CodeBlock { "TargetElements"; }
valueAtKey_11 = DesignScript.Builtin.Dictionary.ValueAtKey(dictionary=code_block_52, key=code_block_68)
code_block_69 = CodeBlock { 0; }
createExcavationSolid_2 = Custom[CreateExcavationSolid](Element=valueAtKey_11, ExcavOffsetTop=code_block_69, ExcavOffsetBottom=code_block_69)
code_block_70 = CodeBlock { "TargetElements"; }
valueAtKey_12 = DesignScript.Builtin.Dictionary.ValueAtKey(dictionary=code_block_54, key=code_block_70)
createBaseCourseSurfaces_2 = Custom[CreateBaseCourseSurfaces](Element=valueAtKey_12)

# group: See Result
code_block_71 = CodeBlock(SeeResult=extractUpperFacesOfElement_2.GeometryColor) { SeeResult; }
code_block_72 = CodeBlock(SeeResult=extractSideFacesOfElement_3.GeometryColor) { SeeResult; }
code_block_73 = CodeBlock(SeeResult=createLeanConcrete_2.GeometryColor) { SeeResult; }
code_block_74 = CodeBlock(SeeResult=createExcavationSolid_2.GeometryColor) { SeeResult; }
code_block_75 = CodeBlock(SeeResult=createBaseCourseSurfaces_2.GeometryColor) { SeeResult; }

# group: 2. Select Target Family Element And Connected WorkMasters
code_block_76 = CodeBlock { 2; }
selectTargetFamilyInformAsDictionary_3 = Custom[SelectTargetFamilyInformAsDictionary](InputDic=organizeAllElementInformAsDictionary, InputIndex=code_block_76)

# group: Distributer
code_block_77 = CodeBlock(i=selectTargetFamilyInformAsDictionary_3) { i; }
code_block_78 = CodeBlock(i=code_block_77) { i; }
code_block_79 = CodeBlock(i=code_block_78) { i; }
code_block_80 = CodeBlock(i=code_block_78) { i; }
code_block_81 = CodeBlock(i=code_block_77) { i; }
code_block_82 = CodeBlock(i=code_block_81) { i; }
code_block_83 = CodeBlock(i=code_block_77) { i; }
code_block_84 = CodeBlock(i=code_block_83) { i; }
code_block_85 = CodeBlock(i=code_block_77) { i; }
code_block_86 = CodeBlock(i=code_block_85) { i; }
code_block_87 = CodeBlock(i=code_block_78) { i; }
code_block_88 = CodeBlock(i=code_block_83) { i; }
code_block_89 = CodeBlock(i=code_block_83) { i; }
code_block_90 = CodeBlock(i=code_block_85) { i; }
code_block_91 = CodeBlock(i=code_block_85) { i; }
code_block_92 = CodeBlock(i=code_block_81) { i; }

code_block_93 = CodeBlock { "TargetElements"; }
valueAtKey_13 = DesignScript.Builtin.Dictionary.ValueAtKey(dictionary=code_block_79, key=code_block_93)
extractUpperFacesOfElement_3 = Custom[ExtractUpperFacesOfElement](Element=valueAtKey_13)

# group: <Func 2> - 수정필요
code_block_94 = CodeBlock { "TargetElements"; }
valueAtKey_14 = DesignScript.Builtin.Dictionary.ValueAtKey(dictionary=code_block_80, key=code_block_94)
# note: <Func>
extractSideFacesOfElement_4 = Custom[ExtractSideFacesOfElement](Element=valueAtKey_14)
area_4 = Surface.Area(surface=extractSideFacesOfElement_4.Surface)
sum_3 = Math.Sum(values=area_4)
code_block_95 = CodeBlock(i=sum_3) { Math.Round(List.Flatten(i)/1000000, 2); }
code_block_96 = CodeBlock { "M2"; }
count_6 = List.Count(list=code_block_95)
ofRepeatedItem_6 = List.OfRepeatedItem(item=code_block_96, amount=count_6)
code_block_97 = CodeBlock(FuncValues=code_block_95, FuncValuesUnit=ofRepeatedItem_6)  # same code as code_block_22

code_block_98 = CodeBlock { "TargetElements"; }
valueAtKey_15 = DesignScript.Builtin.Dictionary.ValueAtKey(dictionary=code_block_82, key=code_block_98)
code_block_99 = CodeBlock { 0; 100; }
createLeanConcrete_3 = Custom[CreateLeanConcrete](Element=valueAtKey_15, leanOffset=code_block_99.out0, leanThick=code_block_99.out1)
code_block_100 = CodeBlock { "TargetElements"; }
valueAtKey_16 = DesignScript.Builtin.Dictionary.ValueAtKey(dictionary=code_block_84, key=code_block_100)
code_block_101 = CodeBlock { 0; }
createExcavationSolid_3 = Custom[CreateExcavationSolid](Element=valueAtKey_16, ExcavOffsetTop=code_block_101, ExcavOffsetBottom=code_block_101)
code_block_102 = CodeBlock { "TargetElements"; }
valueAtKey_17 = DesignScript.Builtin.Dictionary.ValueAtKey(dictionary=code_block_86, key=code_block_102)
createBaseCourseSurfaces_3 = Custom[CreateBaseCourseSurfaces](Element=valueAtKey_17)

# group: See Result
code_block_103 = CodeBlock(SeeResult=extractUpperFacesOfElement_3.GeometryColor) { SeeResult; }
code_block_104 = CodeBlock(SeeResult=extractSideFacesOfElement_4.GeometryColor) { SeeResult; }
code_block_105 = CodeBlock(SeeResult=createLeanConcrete_3.GeometryColor) { SeeResult; }
code_block_106 = CodeBlock(SeeResult=createExcavationSolid_3.GeometryColor) { SeeResult; }
code_block_107 = CodeBlock(SeeResult=createBaseCourseSurfaces_3.GeometryColor) { SeeResult; }

# group: <Func 0>A03AC032: STRUCTURAL CONCRETE
code_block_108 = CodeBlock { "TargetElements"; }
valueAtKey_18 = DesignScript.Builtin.Dictionary.ValueAtKey(dictionary=code_block_16, key=code_block_108)
code_block_109 = CodeBlock { "Volume"; }
# note: <Func>
getParameterValueByName = Element.GetParameterValueByName(element=valueAtKey_18, parameterName=code_block_109)
code_block_110 = CodeBlock(i=getParameterValueByName) { Math.Round(List.Flatten(i)/1, 2); }
code_block_111 = CodeBlock { "M3"; }
count_7 = List.Count(list=code_block_110)
ofRepeatedItem_7 = List.OfRepeatedItem(item=code_block_111, amount=count_7)
code_block_112 = CodeBlock(FuncValues=code_block_110, FuncValuesUnit=ofRepeatedItem_7)  # same code as code_block_22

# group: <Func 7>A03AC037: REBAR WORK
code_block_113 = CodeBlock { "TargetElements"; }
valueAtKey_19 = DesignScript.Builtin.Dictionary.ValueAtKey(dictionary=code_block_17, key=code_block_113)
code_block_114 = CodeBlock { "Volume"; }
# note: <Func>
getParameterValueByName_2 = Element.GetParameterValueByName(element=valueAtKey_19, parameterName=code_block_114)
code_block_115 = CodeBlock { 0.1; }
mul = getParameterValueByName_2 * code_block_115
code_block_116 = CodeBlock(i=mul) { Math.Round(List.Flatten(i)/1, 2); }
code_block_117 = CodeBlock { "TON"; }
count_8 = List.Count(list=code_block_116)
ofRepeatedItem_8 = List.OfRepeatedItem(item=code_block_117, amount=count_8)
code_block_118 = CodeBlock(FuncValues=code_block_116, FuncValuesUnit=ofRepeatedItem_8)  # same code as code_block_22

# group: <Func 8>A03AE059: SHEET MEMBRANE
code_block_119 = CodeBlock { "TargetElements"; }
valueAtKey_20 = DesignScript.Builtin.Dictionary.ValueAtKey(dictionary=code_block_18, key=code_block_119)
# note: <Func>
createLeanConcrete_4 = Custom[CreateLeanConcrete](Element=valueAtKey_20)
area_5 = Surface.Area(surface=createLeanConcrete_4.Surface)
code_block_120 = CodeBlock(i=area_5) { Math.Round(List.Flatten(i)/1000000, 2); }
code_block_121 = CodeBlock { "M2"; }
count_9 = List.Count(list=code_block_120)
ofRepeatedItem_9 = List.OfRepeatedItem(item=code_block_121, amount=count_9)
code_block_122 = CodeBlock(FuncValues=code_block_120, FuncValuesUnit=ofRepeatedItem_9)  # same code as code_block_22

# group (continued): <Func 9>A03AE060: MEMBRANE PROTECTION BOARD
area_6 = Surface.Area(surface=addItemToFront)
sum_4 = Math.Sum(values=area_6)
code_block_123 = CodeBlock(i=sum_4) { Math.Round(List.Flatten(i)/1000000, 2); }
count_10 = List.Count(list=code_block_123)
ofRepeatedItem_10 = List.OfRepeatedItem(item=code_block_36, amount=count_10)
code_block_124 = CodeBlock(FuncValues=code_block_123, FuncValuesUnit=ofRepeatedItem_10)  # same code as code_block_22

join = List.Join(list0=code_block_112, list1=code_block_26, list4=code_block_22, list5=code_block_30, list6=code_block_34, list7=code_block_118, list8=code_block_122, list9=code_block_124)  # unwired: list2, list3

# group: TargetWMunique + Data Sending
code_block_125 = CodeBlock(InputDic2=join) { _InputDic2; }
count_11 = List.Count(list=code_block_125)
code_block_126 = CodeBlock(InputDic1=code_block_8) { _InputDic1; }
code_block_127 = CodeBlock { "TargetWMunique"; }
valueAtKey_21 = DesignScript.Builtin.Dictionary.ValueAtKey(dictionary=code_block_126, key=code_block_127)
watch = Watch(valueAtKey_21)
count_12 = List.Count(list=watch)
eq = count_11 == count_12
organizeFuncValuesAndWorkMasterAsDiction = Custom[OrganizeFuncValuesAndWorkMasterAsDictionary](InputDic1=code_block_126, InputDic2=code_block_125)  # Organize FuncValues and WorkMaster As Dictionary
watch_2 = Watch()  # unwired: arg0
if_ = If(test=eq, true=organizeFuncValuesAndWorkMasterAsDiction, false=watch_2)

# group: 데이터 취합 및 Row 방향 정렬
code_block_128 = CodeBlock(InputDic=if_) { _InputDic; }
code_block_129 = CodeBlock { "TrTargetFamilyCode"; }
valueAtKey_22 = DesignScript.Builtin.Dictionary.ValueAtKey(dictionary=code_block_128, key=code_block_129)
watch_3 = Watch(valueAtKey_22)
flatten_5 = List.Flatten(list=watch_3)
code_block_130 = CodeBlock { "WMforTargetElements"; }
valueAtKey_23 = DesignScript.Builtin.Dictionary.ValueAtKey(dictionary=code_block_128, key=code_block_130)
watch_4 = Watch(valueAtKey_23)
flatten_6 = List.Flatten(list=watch_4)
code_block_131 = CodeBlock { "TargetFuncValues"; }
valueAtKey_24 = DesignScript.Builtin.Dictionary.ValueAtKey(dictionary=code_block_128, key=code_block_131)
watch_5 = Watch(valueAtKey_24)
flatten_7 = List.Flatten(list=watch_5)
code_block_132 = CodeBlock { "TargetFuncValuesUnit"; }
valueAtKey_25 = DesignScript.Builtin.Dictionary.ValueAtKey(dictionary=code_block_128, key=code_block_132)
watch_6 = Watch(valueAtKey_25)
flatten_8 = List.Flatten(list=watch_6)
list_create = List.Create(item0=flatten_5, item1=flatten_6, item2=flatten_7, item3=flatten_8)
transpose = List.Transpose(lists=list_create)

area_7 = Surface.Area(surface=extractUpperFacesOfElement_2.Surface)
sum_5 = Math.Sum(values=area_7)
code_block_133 = CodeBlock(i=sum_5) { Math.Round(List.Flatten(i)/1000000, 2); }
code_block_134 = CodeBlock { "M3"; }
count_13 = List.Count(list=code_block_133)
ofRepeatedItem_11 = List.OfRepeatedItem(item=code_block_134, amount=count_13)
code_block_135 = CodeBlock(FuncValues=code_block_133, FuncValuesUnit=ofRepeatedItem_11)  # same code as code_block_22
code_block_136 = CodeBlock { "TargetElements"; }
valueAtKey_26 = DesignScript.Builtin.Dictionary.ValueAtKey(dictionary=code_block_55, key=code_block_136)
code_block_137 = CodeBlock { "Volume"; }
getParameterValueByName_3 = Element.GetParameterValueByName(element=valueAtKey_26, parameterName=code_block_137)
code_block_138 = CodeBlock(i=getParameterValueByName_3) { Math.Round(List.Flatten(i)/1000000, 2); }
code_block_139 = CodeBlock { "M3"; }
count_14 = List.Count(list=code_block_138)
ofRepeatedItem_12 = List.OfRepeatedItem(item=code_block_139, amount=count_14)
code_block_140 = CodeBlock(FuncValues=code_block_138, FuncValuesUnit=ofRepeatedItem_12)  # same code as code_block_22
code_block_141 = CodeBlock { "TargetElements"; }
valueAtKey_27 = DesignScript.Builtin.Dictionary.ValueAtKey(dictionary=code_block_56, key=code_block_141)
createLeanConcrete_5 = Custom[CreateLeanConcrete](Element=valueAtKey_27)
area_8 = Surface.Area(surface=createLeanConcrete_5.Surface)
code_block_142 = CodeBlock(i=area_8) { Math.Round(List.Flatten(i)/1000000, 2); }
code_block_143 = CodeBlock { "M2"; }
count_15 = List.Count(list=code_block_142)
ofRepeatedItem_13 = List.OfRepeatedItem(item=code_block_143, amount=count_15)
code_block_144 = CodeBlock(FuncValues=code_block_142, FuncValuesUnit=ofRepeatedItem_13)  # same code as code_block_22
map = List.Map()  # unwired: list, function
isNull = Object.IsNull(object=createExcavationSolid_2.Solid)
code_block_145 = CodeBlock { 1; }
mul_2 = _ * code_block_145  # unwired: x
volume_3 = Solid.Volume()  # unwired: solid
if_2 = If(test=isNull, true=mul_2, false=volume_3)
code_block_146 = CodeBlock { 0; }
isNull_2 = Object.IsNull()  # unwired: object
replaceByCondition = Replace(item=createExcavationSolid_2.Solid, replaceWith=code_block_146, condition=isNull_2)
laceShortest = List.LaceShortest(combineFunction=map, list0=if_2, list1=replaceByCondition)
code_block_147 = CodeBlock(i=laceShortest) { Math.Round(List.Flatten(i)/1000000000, 2); }
code_block_148 = CodeBlock { "M3"; }
count_16 = List.Count(list=code_block_147)
ofRepeatedItem_14 = List.OfRepeatedItem(item=code_block_148, amount=count_16)
code_block_149 = CodeBlock(FuncValues=code_block_147, FuncValuesUnit=ofRepeatedItem_14)  # same code as code_block_22
code_block_150 = CodeBlock { 0; }
code_block_151 = CodeBlock { "TargetElements"; }
valueAtKey_28 = DesignScript.Builtin.Dictionary.ValueAtKey(dictionary=code_block_57, key=code_block_151)
count_17 = List.Count(list=valueAtKey_28@L1)
ofRepeatedItem_15 = List.OfRepeatedItem(item=code_block_150, amount=count_17)
code_block_152 = CodeBlock(i=ofRepeatedItem_15) { Math.Round(List.Flatten(i)/1000000000, 2); }
code_block_153 = CodeBlock { "M3"; }
count_18 = List.Count(list=code_block_152)
ofRepeatedItem_16 = List.OfRepeatedItem(item=code_block_153, amount=count_18)
code_block_154 = CodeBlock(FuncValues=code_block_152, FuncValuesUnit=ofRepeatedItem_16)  # same code as code_block_22
code_block_155 = CodeBlock { 0; }
code_block_156 = CodeBlock { "TargetElements"; }
valueAtKey_29 = DesignScript.Builtin.Dictionary.ValueAtKey(dictionary=code_block_58, key=code_block_156)
count_19 = List.Count(list=valueAtKey_29@L1)
ofRepeatedItem_17 = List.OfRepeatedItem(item=code_block_155, amount=count_19)
code_block_157 = CodeBlock(i=ofRepeatedItem_17) { Math.Round(List.Flatten(i)/1000000000, 2); }
code_block_158 = CodeBlock { "M3"; }
count_20 = List.Count(list=code_block_157)
ofRepeatedItem_18 = List.OfRepeatedItem(item=code_block_158, amount=count_20)
code_block_159 = CodeBlock(FuncValues=code_block_157, FuncValuesUnit=ofRepeatedItem_18)  # same code as code_block_22
area_9 = Surface.Area(surface=createBaseCourseSurfaces_2.Surface)
code_block_160 = CodeBlock(i=area_9) { Math.Round(List.Flatten(i)/1000000, 2); }
code_block_161 = CodeBlock { "M2"; }
count_21 = List.Count(list=code_block_160)
ofRepeatedItem_19 = List.OfRepeatedItem(item=code_block_161, amount=count_21)
code_block_162 = CodeBlock(FuncValues=code_block_160, FuncValuesUnit=ofRepeatedItem_19)  # same code as code_block_22
code_block_163 = CodeBlock { 0; }
code_block_164 = CodeBlock { "TargetElements"; }
valueAtKey_30 = DesignScript.Builtin.Dictionary.ValueAtKey(dictionary=code_block_59, key=code_block_164)
count_22 = List.Count(list=valueAtKey_30@L1)
ofRepeatedItem_20 = List.OfRepeatedItem(item=code_block_163, amount=count_22)
code_block_165 = CodeBlock(i=ofRepeatedItem_20) { Math.Round(List.Flatten(i)/1000000000, 2); }
code_block_166 = CodeBlock { "M3"; }
count_23 = List.Count(list=code_block_165)
ofRepeatedItem_21 = List.OfRepeatedItem(item=code_block_166, amount=count_23)
code_block_167 = CodeBlock(FuncValues=code_block_165, FuncValuesUnit=ofRepeatedItem_21)  # same code as code_block_22
volume_4 = Solid.Volume(solid=createLeanConcrete_2.Solid)
code_block_168 = CodeBlock(i=volume_4) { Math.Round(List.Flatten(i)/1000000000, 2); }
code_block_169 = CodeBlock { "M3"; }
count_24 = List.Count(list=code_block_168)
ofRepeatedItem_22 = List.OfRepeatedItem(item=code_block_169, amount=count_24)
code_block_170 = CodeBlock(FuncValues=code_block_168, FuncValuesUnit=ofRepeatedItem_22)  # same code as code_block_22
code_block_171 = CodeBlock { "TargetElements"; }
valueAtKey_31 = DesignScript.Builtin.Dictionary.ValueAtKey(dictionary=code_block_60, key=code_block_171)
code_block_172 = CodeBlock { "Volume"; }
getParameterValueByName_4 = Element.GetParameterValueByName(element=valueAtKey_31, parameterName=code_block_172)
code_block_173 = CodeBlock { 0.1; }
mul_3 = getParameterValueByName_4 * code_block_173
code_block_174 = CodeBlock(i=mul_3) { Math.Round(List.Flatten(i)/1, 2); }
code_block_175 = CodeBlock { "TON"; }
count_25 = List.Count(list=code_block_174)
ofRepeatedItem_23 = List.OfRepeatedItem(item=code_block_175, amount=count_25)
code_block_176 = CodeBlock(FuncValues=code_block_174, FuncValuesUnit=ofRepeatedItem_23)  # same code as code_block_22
join_2 = List.Join(list0=code_block_135, list1=code_block_140, list2=code_block_65, list3=code_block_144, list4=code_block_149, list5=code_block_154, list6=code_block_159, list7=code_block_162, list8=code_block_167, list9=code_block_170, list10=code_block_176)

# group: TargetWMunique + Data Sending
code_block_177 = CodeBlock(InputDic2=join_2) { _InputDic2; }
count_26 = List.Count(list=code_block_177)
code_block_178 = CodeBlock(InputDic1=code_block_45) { _InputDic1; }
code_block_179 = CodeBlock { "TargetWMunique"; }
valueAtKey_32 = DesignScript.Builtin.Dictionary.ValueAtKey(dictionary=code_block_178, key=code_block_179)
watch_7 = Watch(valueAtKey_32)
count_27 = List.Count(list=watch_7)
eq_2 = count_26 == count_27
organizeFuncValuesAndWorkMasterAsDiction_2 = Custom[OrganizeFuncValuesAndWorkMasterAsDictionary](InputDic1=code_block_178, InputDic2=code_block_177)
watch_8 = Watch()  # unwired: arg0
if_3 = If(test=eq_2, true=organizeFuncValuesAndWorkMasterAsDiction_2, false=watch_8)

# group: 데이터 취합 및 Row 방향 정렬
code_block_180 = CodeBlock(InputDic=if_3) { _InputDic; }
code_block_181 = CodeBlock { "TrTargetFamilyCode"; }
valueAtKey_33 = DesignScript.Builtin.Dictionary.ValueAtKey(dictionary=code_block_180, key=code_block_181)
watch_9 = Watch(valueAtKey_33)
flatten_9 = List.Flatten(list=watch_9)
code_block_182 = CodeBlock { "WMforTargetElements"; }
valueAtKey_34 = DesignScript.Builtin.Dictionary.ValueAtKey(dictionary=code_block_180, key=code_block_182)
watch_10 = Watch(valueAtKey_34)
flatten_10 = List.Flatten(list=watch_10)
code_block_183 = CodeBlock { "TargetFuncValues"; }
valueAtKey_35 = DesignScript.Builtin.Dictionary.ValueAtKey(dictionary=code_block_180, key=code_block_183)
watch_11 = Watch(valueAtKey_35)
flatten_11 = List.Flatten(list=watch_11)
code_block_184 = CodeBlock { "TargetFuncValuesUnit"; }
valueAtKey_36 = DesignScript.Builtin.Dictionary.ValueAtKey(dictionary=code_block_180, key=code_block_184)
watch_12 = Watch(valueAtKey_36)
flatten_12 = List.Flatten(list=watch_12)
list_create_2 = List.Create(item0=flatten_9, item1=flatten_10, item2=flatten_11, item3=flatten_12)
transpose_2 = List.Transpose(lists=list_create_2)

area_10 = Surface.Area(surface=extractUpperFacesOfElement_3.Surface)
sum_6 = Math.Sum(values=area_10)
code_block_185 = CodeBlock(i=sum_6) { Math.Round(List.Flatten(i)/1000000, 2); }
code_block_186 = CodeBlock { "M3"; }
count_28 = List.Count(list=code_block_185)
ofRepeatedItem_24 = List.OfRepeatedItem(item=code_block_186, amount=count_28)
code_block_187 = CodeBlock(FuncValues=code_block_185, FuncValuesUnit=ofRepeatedItem_24)  # same code as code_block_22
code_block_188 = CodeBlock { "TargetElements"; }
valueAtKey_37 = DesignScript.Builtin.Dictionary.ValueAtKey(dictionary=code_block_87, key=code_block_188)
code_block_189 = CodeBlock { "Volume"; }
getParameterValueByName_5 = Element.GetParameterValueByName(element=valueAtKey_37, parameterName=code_block_189)
code_block_190 = CodeBlock(i=getParameterValueByName_5) { Math.Round(List.Flatten(i)/1000000, 2); }
code_block_191 = CodeBlock { "M3"; }
count_29 = List.Count(list=code_block_190)
ofRepeatedItem_25 = List.OfRepeatedItem(item=code_block_191, amount=count_29)
code_block_192 = CodeBlock(FuncValues=code_block_190, FuncValuesUnit=ofRepeatedItem_25)  # same code as code_block_22
code_block_193 = CodeBlock { "TargetElements"; }
valueAtKey_38 = DesignScript.Builtin.Dictionary.ValueAtKey(dictionary=code_block_88, key=code_block_193)
createLeanConcrete_6 = Custom[CreateLeanConcrete](Element=valueAtKey_38)
area_11 = Surface.Area(surface=createLeanConcrete_6.Surface)
code_block_194 = CodeBlock(i=area_11) { Math.Round(List.Flatten(i)/1000000, 2); }
code_block_195 = CodeBlock { "M2"; }
count_30 = List.Count(list=code_block_194)
ofRepeatedItem_26 = List.OfRepeatedItem(item=code_block_195, amount=count_30)
code_block_196 = CodeBlock(FuncValues=code_block_194, FuncValuesUnit=ofRepeatedItem_26)  # same code as code_block_22
map_2 = List.Map()  # unwired: list, function
isNull_3 = Object.IsNull(object=createExcavationSolid_3.Solid)
code_block_197 = CodeBlock { 1; }
mul_4 = _ * code_block_197  # unwired: x
volume_5 = Solid.Volume()  # unwired: solid
if_4 = If(test=isNull_3, true=mul_4, false=volume_5)
code_block_198 = CodeBlock { 0; }
isNull_4 = Object.IsNull()  # unwired: object
replaceByCondition_2 = Replace(item=createExcavationSolid_3.Solid, replaceWith=code_block_198, condition=isNull_4)
laceShortest_2 = List.LaceShortest(combineFunction=map_2, list0=if_4, list1=replaceByCondition_2)
code_block_199 = CodeBlock(i=laceShortest_2) { Math.Round(List.Flatten(i)/1000000000, 2); }
code_block_200 = CodeBlock { "M3"; }
count_31 = List.Count(list=code_block_199)
ofRepeatedItem_27 = List.OfRepeatedItem(item=code_block_200, amount=count_31)
code_block_201 = CodeBlock(FuncValues=code_block_199, FuncValuesUnit=ofRepeatedItem_27)  # same code as code_block_22
code_block_202 = CodeBlock { 0; }
code_block_203 = CodeBlock { "TargetElements"; }
valueAtKey_39 = DesignScript.Builtin.Dictionary.ValueAtKey(dictionary=code_block_89, key=code_block_203)
count_32 = List.Count(list=valueAtKey_39@L1)
ofRepeatedItem_28 = List.OfRepeatedItem(item=code_block_202, amount=count_32)
code_block_204 = CodeBlock(i=ofRepeatedItem_28) { Math.Round(List.Flatten(i)/1000000000, 2); }
code_block_205 = CodeBlock { "M3"; }
count_33 = List.Count(list=code_block_204)
ofRepeatedItem_29 = List.OfRepeatedItem(item=code_block_205, amount=count_33)
code_block_206 = CodeBlock(FuncValues=code_block_204, FuncValuesUnit=ofRepeatedItem_29)  # same code as code_block_22
code_block_207 = CodeBlock { 0; }
code_block_208 = CodeBlock { "TargetElements"; }
valueAtKey_40 = DesignScript.Builtin.Dictionary.ValueAtKey(dictionary=code_block_90, key=code_block_208)
count_34 = List.Count(list=valueAtKey_40@L1)
ofRepeatedItem_30 = List.OfRepeatedItem(item=code_block_207, amount=count_34)
code_block_209 = CodeBlock(i=ofRepeatedItem_30) { Math.Round(List.Flatten(i)/1000000000, 2); }
code_block_210 = CodeBlock { "M3"; }
count_35 = List.Count(list=code_block_209)
ofRepeatedItem_31 = List.OfRepeatedItem(item=code_block_210, amount=count_35)
code_block_211 = CodeBlock(FuncValues=code_block_209, FuncValuesUnit=ofRepeatedItem_31)  # same code as code_block_22
area_12 = Surface.Area(surface=createBaseCourseSurfaces_3.Surface)
code_block_212 = CodeBlock(i=area_12) { Math.Round(List.Flatten(i)/1000000, 2); }
code_block_213 = CodeBlock { "M2"; }
count_36 = List.Count(list=code_block_212)
ofRepeatedItem_32 = List.OfRepeatedItem(item=code_block_213, amount=count_36)
code_block_214 = CodeBlock(FuncValues=code_block_212, FuncValuesUnit=ofRepeatedItem_32)  # same code as code_block_22
code_block_215 = CodeBlock { 0; }
code_block_216 = CodeBlock { "TargetElements"; }
valueAtKey_41 = DesignScript.Builtin.Dictionary.ValueAtKey(dictionary=code_block_91, key=code_block_216)
count_37 = List.Count(list=valueAtKey_41@L1)
ofRepeatedItem_33 = List.OfRepeatedItem(item=code_block_215, amount=count_37)
code_block_217 = CodeBlock(i=ofRepeatedItem_33) { Math.Round(List.Flatten(i)/1000000000, 2); }
code_block_218 = CodeBlock { "M3"; }
count_38 = List.Count(list=code_block_217)
ofRepeatedItem_34 = List.OfRepeatedItem(item=code_block_218, amount=count_38)
code_block_219 = CodeBlock(FuncValues=code_block_217, FuncValuesUnit=ofRepeatedItem_34)  # same code as code_block_22
volume_6 = Solid.Volume(solid=createLeanConcrete_3.Solid)
code_block_220 = CodeBlock(i=volume_6) { Math.Round(List.Flatten(i)/1000000000, 2); }
code_block_221 = CodeBlock { "M3"; }
count_39 = List.Count(list=code_block_220)
ofRepeatedItem_35 = List.OfRepeatedItem(item=code_block_221, amount=count_39)
code_block_222 = CodeBlock(FuncValues=code_block_220, FuncValuesUnit=ofRepeatedItem_35)  # same code as code_block_22
code_block_223 = CodeBlock { "TargetElements"; }
valueAtKey_42 = DesignScript.Builtin.Dictionary.ValueAtKey(dictionary=code_block_92, key=code_block_223)
code_block_224 = CodeBlock { "Volume"; }
getParameterValueByName_6 = Element.GetParameterValueByName(element=valueAtKey_42, parameterName=code_block_224)
code_block_225 = CodeBlock { 0.1; }
mul_5 = getParameterValueByName_6 * code_block_225
code_block_226 = CodeBlock(i=mul_5) { Math.Round(List.Flatten(i)/1, 2); }
code_block_227 = CodeBlock { "TON"; }
count_40 = List.Count(list=code_block_226)
ofRepeatedItem_36 = List.OfRepeatedItem(item=code_block_227, amount=count_40)
code_block_228 = CodeBlock(FuncValues=code_block_226, FuncValuesUnit=ofRepeatedItem_36)  # same code as code_block_22
join_3 = List.Join(list0=code_block_187, list1=code_block_192, list2=code_block_97, list3=code_block_196, list4=code_block_201, list5=code_block_206, list6=code_block_211, list7=code_block_214, list8=code_block_219, list9=code_block_222, list10=code_block_228)

# group: TargetWMunique + Data Sending
code_block_229 = CodeBlock(InputDic2=join_3) { _InputDic2; }
count_41 = List.Count(list=code_block_229)
code_block_230 = CodeBlock(InputDic1=code_block_77) { _InputDic1; }
code_block_231 = CodeBlock { "TargetWMunique"; }
valueAtKey_43 = DesignScript.Builtin.Dictionary.ValueAtKey(dictionary=code_block_230, key=code_block_231)
watch_13 = Watch(valueAtKey_43)
count_42 = List.Count(list=watch_13)
eq_3 = count_41 == count_42
organizeFuncValuesAndWorkMasterAsDiction_3 = Custom[OrganizeFuncValuesAndWorkMasterAsDictionary](InputDic1=code_block_230, InputDic2=code_block_229)
watch_14 = Watch()  # unwired: arg0
if_5 = If(test=eq_3, true=organizeFuncValuesAndWorkMasterAsDiction_3, false=watch_14)

# group: 데이터 취합 및 Row 방향 정렬
code_block_232 = CodeBlock(InputDic=if_5) { _InputDic; }
code_block_233 = CodeBlock { "TrTargetFamilyCode"; }
valueAtKey_44 = DesignScript.Builtin.Dictionary.ValueAtKey(dictionary=code_block_232, key=code_block_233)
watch_15 = Watch(valueAtKey_44)
flatten_13 = List.Flatten(list=watch_15)
code_block_234 = CodeBlock { "WMforTargetElements"; }
valueAtKey_45 = DesignScript.Builtin.Dictionary.ValueAtKey(dictionary=code_block_232, key=code_block_234)
watch_16 = Watch(valueAtKey_45)
flatten_14 = List.Flatten(list=watch_16)
code_block_235 = CodeBlock { "TargetFuncValues"; }
valueAtKey_46 = DesignScript.Builtin.Dictionary.ValueAtKey(dictionary=code_block_232, key=code_block_235)
watch_17 = Watch(valueAtKey_46)
flatten_15 = List.Flatten(list=watch_17)
code_block_236 = CodeBlock { "TargetFuncValuesUnit"; }
valueAtKey_47 = DesignScript.Builtin.Dictionary.ValueAtKey(dictionary=code_block_232, key=code_block_236)
watch_18 = Watch(valueAtKey_47)
flatten_16 = List.Flatten(list=watch_18)
list_create_3 = List.Create(item0=flatten_13, item1=flatten_14, item2=flatten_15, item3=flatten_16)
transpose_3 = List.Transpose(lists=list_create_3)

# group: 패밀리 별 취합 + Export Excel(By OpenpyXl)
# note: Excel Export Button
boolean = BoolSelector(false)
join_4 = List.Join(list0=transpose, list1=transpose_2, list2=transpose_3)
watch_19 = Watch()  # unwired: arg0
if_6 = If(test=boolean, true=join_4, false=watch_19)
python_script_export_excel_by = Python(IN[0]=if_6)  # "Python Script@Export Excel(By OpenpyXl)"; CPython3
# ---------- python_script_export_excel_by.python (151 lines) ----------
# Load the Python Standard and DesignScript Libraries
import sys
import os
#sys.path.append(r'C:\Users\HEC\AppData\Local\Programs\Python\Python39\Lib\site-packages')
#sys.path.append(r'C:\Users\pjmk0\AppData\Local\Programs\Python\Python39\Lib\site-packages')
sys.path.append(os.getenv('LOCALAPPDATA').replace('\\','\\\\') + r'\Programs\Python\Python39\Lib\site-packages')
import clr
clr.AddReference('ProtoGeometry')
from Autodesk.DesignScript.Geometry import *
from collections import Iterable

def iterable(obj):
    return isinstance(obj, Iterable)


# The inputs to this node will be stored as a list in the IN variables.
dataEnteringNode = IN
ListIn = IN[0]

# Place your code below this line
import datetime
from datetime import date, timedelta
Today = date.today()
import openpyxl
from openpyxl.styles import Border, Side, PatternFill, Font, GradientFill, Alignment, Color, numbers

sample_items = ListIn


def write_to_file(filepath):
    wb = openpyxl.Workbook()
    for sheet in wb.sheetnames:
        wb.remove(wb[sheet])

    thin = Side(border_style="thin", color="000000")
    double = Side(border_style="double", color="000000")

    ws = wb.create_sheet(title='Wall_Calc_instance', index=0)

    ws.merge_cells('A1:L1')
    ws['A1'] = 'HEC Wall Category Calculation Sheet'
    cell = ws['A1']
    cell.font = openpyxl.styles.Font(color='000000', size=20)
    cell.fill = openpyxl.styles.fills.PatternFill(patternType='solid',
                                                  fgColor=openpyxl.styles.colors.Color(rgb='fff3b0'))

    ws['A2'] = 'Item Number'
    ws['A2'].font = openpyxl.styles.Font(b=True, color='000000', size=12)
    #ws['B2'] = 'Member Name'
    #ws['B2'].font = openpyxl.styles.Font(b=True, color='000000', size=12)
    #ws['C2'] = 'Category'
    #ws['C2'].font = openpyxl.styles.Font(b=True, color='000000', size=12)
    ws['B2'] = 'Family Type'
    ws['B2'].font = openpyxl.styles.Font(b=True, color='000000', size=12)
    ws['C2'] = 'WorkMaster Code'
    ws['C2'].font = openpyxl.styles.Font(b=True, color='000000', size=12)
    #ws['F2'] = 'WorkMaster Description'
    #ws['F2'].font = openpyxl.styles.Font(b=True, color='000000', size=12)
    #ws['G2'] = 'Unit'
    #ws['G2'].font = openpyxl.styles.Font(b=True, color='000000', size=12)
    #ws['H2'] = '계수'
    #ws['H2'].font = openpyxl.styles.Font(b=True, color='000000', size=12)
    #ws['I2'] = '계산 참조값'
    #ws['I2'].font = openpyxl.styles.Font(b=True, color='000000', size=12)
    ws['D2'] = 'Quantities'
    ws['D2'].font = openpyxl.styles.Font(b=True, color='000000', size=12)
    ws['E2'] = 'Unit'
    ws['E2'].font = openpyxl.styles.Font(b=True, color='000000', size=12)
    ws['F2'] = 'Unit Price'
    ws['F2'].font = openpyxl.styles.Font(b=True, color='000000', size=12)
    ws['G2'] = 'Total Price'
    ws['G2'].font = openpyxl.styles.Font(b=True, color='000000', size=12)


## 칼럼별 너비 조정 구간
#    for col in range(ws.max_column):
#        ws.column_dimensions[chr(ord('A') + col)].width = 15
    ws.column_dimensions['A'].width = 15
    ws.column_dimensions['B'].width = 45
    ws.column_dimensions['C'].width = 60
    ws.column_dimensions['D'].width = 20
    ws.column_dimensions['E'].width = 20
    ws.column_dimensions['F'].width = 20
    ws.column_dimensions['G'].width = 20
    #ws.column_dimensions['G'].width = 9
    #ws.column_dimensions['H'].width = 9
    #ws.column_dimensions['H'].hidden = True
    #ws.column_dimensions['I'].width = 12
    #ws.column_dimensions['I'].hidden = True
    #ws.column_dimensions['J'].width = 12
    #ws.column_dimensions['K'].width = 12
    #ws.column_dimensions['L'].width = 12

###
    start_row = 3
    for (row, item) in enumerate(sample_items, start_row):
        cell = ws.cell(row=row, column=1, value=row - 2)
        cell.alignment = openpyxl.styles.Alignment(horizontal='center', vertical='center')

#        cell = ws.cell(row=row, column=2, value=item[0])
#        cell.number_format = openpyxl.styles.numbers.FORMAT_DATE_YYYYMMDD2  # 'yyyy-mm-dd'
        ws.cell(row=row, column=2, value=item[0]) ## Family Type 칼럼

        ws.cell(row=row, column=3, value=item[1]) ## WorkMaster Code 칼럼
        
        ws.cell(row=row, column=4, value=item[2]) ## Quantities 칼럼
        
        ws.cell(row=row, column=5, value=item[3]) ## Unit 칼럼
        
        #cell = ws.cell(row=row, column=8, value=item[6]) ## 계수 칼럼
        #cell.number_format = openpyxl.styles.numbers.builtin_format_code(3)  # '#,##0'
        
        #cell = ws.cell(row=row, column=9, value=item[7]) ## 계산 참조값 칼럼
        #cell.number_format = openpyxl.styles.numbers.builtin_format_code(3)  # '#,##0'
        
        #cell = ws.cell(row=row, column=10, value=item[8]) ## Quantities 칼럼
        #cell.number_format = openpyxl.styles.numbers.builtin_format_code(3)  # '#,##0'
        #cell.font = openpyxl.styles.Font(b=True, color='000000', size=11)

        cell = ws.cell(row=row, column=7, value='= D{current_row}*F{current_row}'.format(current_row=cell.row))
        cell.number_format = '#,##0'

#        cell = ws.cell(row=row, column=6, value='= D{current_row} * E{current_row}'.format(current_row=cell.row))
#        cell.number_format = openpyxl.styles.numbers.builtin_format_code(3)

    total_row = ws.max_row + 1
    if total_row > start_row:
        cell1 = ws.cell(row=total_row, column=6, value='Total')
        cell1.font = openpyxl.styles.Font(b=True, color='000000', size=15)
        
        cell2 = ws.cell(row=total_row, column=7, value='= SUM(G{}:G{})'.format(start_row, total_row - 1))
        cell2.number_format = openpyxl.styles.numbers.builtin_format_code(3)
        cell2.border = Border(top=double, left=double, right=double, bottom=double)
        cell2.font = openpyxl.styles.Font(b=True, color='ff03ce', size=15)
    

    wb.save(filepath)
    wb.close()


##if __name__ == '__main__':
#write_to_file('C:\\Users\\pjmk0\\AppData\\Roaming\\test.xlsx')

save_name = "HecStrFDNCalcSheet_" + Today.strftime("%Y-%m-%d")+".xlsx"
path = os.getenv('APPDATA').replace('\\','\\\\')
filePath = path + '\\' + save_name

write_to_file(filePath)

# Assign your output to the OUT variable.
OUT = os.getenv('APPDATA')
# ----------------------------------------
