# Dynamo graph Str Foundation Calculator_HEC(0712).dyn (Dynamo 2.10.1.3976)

# group: select all Category element
categories = Categories("OST_StructuralFoundation")
all_elements_of_category = ElementsOfCategory(Category=categories)
code_block = CodeBlock { "Level"; }
parameterByName = Parameter.ParameterByName(element=all_elements_of_category, name=code_block)
string_from_object = FromObject(object=parameterByName)
uniqueItems = List.UniqueItems(list=string_from_object)
code_block_2 = CodeBlock(i=string_from_object, j=uniqueItems) { i == j[0]; }
filterByBoolMask = List.FilterByBoolMask(list=all_elements_of_category, mask=code_block_2)

watch = Watch(filterByBoolMask.in)
watch_2 = Watch(filterByBoolMask.out)
watch_3 = Watch(all_elements_of_category)
name = FamilyType.Name(familyType=watch_3)
string_from_object_2 = FromObject(object=name)
code_block_3 = CodeBlock { "FT112"; }
contains = String.Contains(str=string_from_object_2, searchFor=code_block_3)
filterByBoolMask_2 = List.FilterByBoolMask(list=watch_3, mask=contains)
watch_4 = Watch(filterByBoolMask_2.in)

# group: All faces
faces = Element.Faces(element=watch_4)

# group: 하부, 측부 Surface 추출 경사에 따라 Vector 값 범위 확정 필요 [ ] > 확정 후 하부, 측부 분리 > 분리 후 edge 추출 진행 > 분리 후 면적 총합 산출 진행
flatten = List.Flatten(list=faces)
code_block_4 = CodeBlock { 0.5; }
normalAtParameter = Surface.NormalAtParameter(surface=flatten, u=code_block_4, v=code_block_4)
Z = Vector.Z(vector=normalAtParameter@L2)
code_block_5 = CodeBlock(a=Z) { a<0; }
filterByBoolMask_3 = List.FilterByBoolMask(list=flatten, mask=code_block_5@L2)
# note: Surface 겹침 확인 필요 격자형
# 침
watch_5 = Watch(filterByBoolMask_3.in)
flatten_2 = List.Flatten(list=watch_5)
code_block_6 = CodeBlock(a=Z) { a==0; }
filterByBoolMask_4 = List.FilterByBoolMask(list=flatten, mask=code_block_6@L2)
watch_6 = Watch(filterByBoolMask_4.in)
flatten_3 = List.Flatten(list=watch_6)
code_block_7 = CodeBlock(i=Z) { i == 1 ||i == -1? false:true; }
isAlmostEqualTo = Vector.IsAlmostEqualTo()  # unwired: vector, other

# group: edge 검토 후 진행
perimeterCurves = Surface.PerimeterCurves(surface=flatten_2)
perimeterCurves_2 = Surface.PerimeterCurves(surface=flatten_3)

code_block_8 = CodeBlock { 2; }
round = Math.Round(number=Z, digits=code_block_8)
code_block_9 = CodeBlock(a=round) { a==0; a>0; a<0; a==-1; }
filterByBoolMask_5 = List.FilterByBoolMask(list=flatten, mask=code_block_9.out3@L2)
watch_7 = Watch(filterByBoolMask_5.in)
flatten_4 = List.Flatten(list=watch_7)
byGeometry = BoundingBox.ByGeometry(geom=flatten_4)
toCuboid = BoundingBox.ToCuboid(boundingBox=byGeometry)
explode = Geometry.Explode(geometry=toCuboid)
perimeterCurves_3 = Surface.PerimeterCurves(surface=explode)
startPoint = Curve.StartPoint(curve=perimeterCurves_3)

# group: 독립 기초용 따로 만들어야함
boolean = BoolSelector(true)
byPoints = PolyCurve.ByPoints(points=startPoint, connectLastToFirst=boolean)
code_block_10 = CodeBlock { 100; }
offset = Curve.Offset(curve=byPoints, distance=code_block_10)
code_block_11 = CodeBlock { 700; }
offset_2 = Curve.Offset(curve=byPoints, distance=code_block_11)
ZAxis = Vector.ZAxis()
code_block_12 = CodeBlock { 1000; }
translate = Geometry.Translate(geometry=offset_2, direction=ZAxis, distance=code_block_12)
join = List.Join(list0=offset, list1=translate)
byLoft = Solid.ByLoft(crossSections=join)
code_block_13 = CodeBlock { 100; }
byARGB = Color.ByARGB(a=code_block_13, r=code_block_13)
byGeometryColor = Modifiers.GeometryColor.ByGeometryColor(geometry=byLoft, color=byARGB)

watch_8 = Watch(byLoft)
volume = Solid.Volume(solid=watch_8)
categories_2 = Categories("OST_StructuralFraming")
all_elements_of_category_2 = ElementsOfCategory(Category=categories_2)
geometry = Element.Geometry(element=all_elements_of_category_2)
categories_3 = Categories("OST_StructuralColumns")
all_elements_of_category_3 = ElementsOfCategory(Category=categories_3)
geometry_2 = Element.Geometry(element=all_elements_of_category_3)
geometry_3 = Element.Geometry(element=all_elements_of_category)
list_create = List.Create(item0=geometry, item1=geometry_2, item2=geometry_3)
flatten_5 = List.Flatten(list=list_create)
byUnion = Solid.ByUnion(solids=flatten_5)
intersect = Geometry.Intersect(geometry=watch_8, other=byUnion)
volume_2 = Solid.Volume(solid=intersect)
sub = volume - volume_2
watch_9 = Watch(sub)

# group: Str Framing
code_block_14 = CodeBlock {  }
code_block_15 = CodeBlock {  }

perimeterCurves_4 = Surface.PerimeterCurves(surface=flatten_4)
startPoint_2 = Curve.StartPoint(curve=perimeterCurves_4)
boolean_2 = BoolSelector(true)
byPoints_2 = PolyCurve.ByPoints(points=startPoint_2, connectLastToFirst=boolean_2)
code_block_16 = CodeBlock { 100; }
offset_3 = Curve.Offset(curve=byPoints_2, distance=code_block_16)
code_block_17 = CodeBlock { 0.5; }
normalAtParameter_2 = Surface.NormalAtParameter(surface=flatten_4, u=code_block_17, v=code_block_17)
Z_2 = Vector.Z(vector=normalAtParameter_2)
watch_10 = Watch(Z_2)
code_block_18 = CodeBlock(z=watch_10) { z>0; }
reverse = Vector.Reverse(vector=normalAtParameter_2)
if_ = If(test=code_block_18, true=reverse, false=normalAtParameter_2)
code_block_19 = CodeBlock { 400; }
extrudeAsSolid = Curve.ExtrudeAsSolid(curve=offset_3, direction=if_, distance=code_block_19)
explode_2 = Geometry.Explode(geometry=extrudeAsSolid)
flatten_6 = List.Flatten(list=explode_2)
code_block_20 = CodeBlock { 0.5; }
normalAtParameter_3 = Surface.NormalAtParameter(surface=flatten_6, u=code_block_20, v=code_block_20)
Z_3 = Vector.Z(vector=normalAtParameter_3@L2)
code_block_21 = CodeBlock { 2; }
round_2 = Math.Round(number=Z_3, digits=code_block_21)
code_block_22 = CodeBlock(a=round_2) { a==0; a>0; a<0; }
filterByBoolMask_6 = List.FilterByBoolMask(list=flatten_6, mask=code_block_22.out2@L2)
flatten_7 = List.Flatten(list=filterByBoolMask_6.in)
perimeterCurves_5 = Surface.PerimeterCurves(surface=flatten_7)
startPoint_3 = Curve.StartPoint(curve=perimeterCurves_5)
boolean_3 = BoolSelector(true)
byPoints_3 = PolyCurve.ByPoints(points=startPoint_3, connectLastToFirst=boolean_3)
code_block_23 = CodeBlock { 100; }
offset_4 = Curve.Offset(curve=byPoints_3, distance=code_block_23)
code_block_24 = CodeBlock { 0.5; }
normalAtParameter_4 = Surface.NormalAtParameter(surface=flatten_7, u=code_block_24, v=code_block_24)
Z_4 = Vector.Z(vector=normalAtParameter_4)
watch_11 = Watch(Z_4)
code_block_25 = CodeBlock(z=watch_11) { z>0; }
reverse_2 = Vector.Reverse(vector=normalAtParameter_4)
if_2 = If(test=code_block_25, true=reverse_2, false=normalAtParameter_4)
code_block_26 = CodeBlock { 200; }
extrudeAsSolid_2 = Curve.ExtrudeAsSolid(curve=offset_4, direction=if_2, distance=code_block_26)

# group: All Elements of Category - STR FDN
categories_4 = Categories("OST_StructuralFoundation")
all_elements_of_category_4 = ElementsOfCategory(Category=categories_4)

# group: All Elements of Category
watch_all_elements_of_category = Watch(all_elements_of_category_4)  # "Watch@All Elements of Category - WALLS"

# group: D. Family Type
watch_all_elements_of_category_2 = Watch(watch_all_elements_of_category)  # "Watch@All Elements of Category - WALLS"
name_2 = Element.Name(element=watch_all_elements_of_category_2)

# group: Excel Import
file_path = Filename(".\BIM_물량집계 자동화 산출기준표_Str Foundation.xlsx")
file_from_path = FileObject(path=file_path)
string_from_object_3 = FromObject(object=file_from_path)
code_block_27 = CodeBlock { "Scope_lv2(Str Foundations)"; }
python_script_import_excel_by = Python(IN[0]=string_from_object_3, IN[1]=code_block_27)  # "Python Script@Import Excel(By OpenpyXl)"; CPython3
# ---------- python_script_import_excel_by.python (50 lines) ----------
# Load the Python Standard and DesignScript Libraries
import sys
import os
#sys.path.append(r'C:\Users\HEC\AppData\Local\Programs\Python\Python39\Lib\site-packages')
#sys.path.append(r'C:\Users\pjmk0\AppData\Local\Programs\Python\Python39\Lib\site-packages')
sys.path.append(os.getenv('LOCALAPPDATA').replace('\\','\\\\') + r'\Programs\Python\Python39\Lib\site-packages')
import clr
clr.AddReference('ProtoGeometry')
from Autodesk.DesignScript.Geometry import *
from collections import Iterable

def iterable(obj):
    return isinstance(obj, Iterable)


# The inputs to this node will be stored as a list in the IN variables.
dataEnteringNode = IN
PathIn = IN[0]
SheetNameIn = IN[1]

# Place your code below this line
import datetime
import openpyxl

path = (PathIn)
#path = (r'C:\Users\pjmk0\Downloads\MK\mQ\BIM_물량집계 자동화 산출기준표_rC(20210607)_mk_de.xlsx')

wb_obj = openpyxl.load_workbook(path, data_only=True)
sheet_obj = wb_obj.get_sheet_by_name(SheetNameIn)

m_row = sheet_obj.max_row
m_col = sheet_obj.max_column

listOut = []



for i in range(1, m_row +1):
    listTemp = []
    for j in range(1, m_col + 1):
        cell_obj = sheet_obj.cell(row=i, column=j)
        listTemp.append(cell_obj.value)
        if len(listTemp) == m_col:
            listOut.append(listTemp)
        


# Assign your output to the OUT variable.
OUT = listOut
#OUT = os.getenv('APPDATA')
# ----------------------------------------
code_block_28 = CodeBlock { false; }
importExcel = Data.ImportExcel(file=file_from_path, sheetName=code_block_27, showExcel=code_block_28)  # frozen

# group: Null값 처리
code_block_29 = CodeBlock { " "; }
isNull = Object.IsNull()  # unwired: object
replaceByCondition = Replace(item=python_script_import_excel_by, replaceWith=code_block_29, condition=isNull)

# group: Whole Data(Column direction)
transpose = List.Transpose(lists=replaceByCondition)
watch_12 = Watch(transpose)

# group: Whole Data(row direction)
watch_13 = Watch(replaceByCondition)

# group: Column Index Guide
code_block_30 = CodeBlock(i=watch_13) { i[3]; }
watch_14 = Watch(code_block_30)

# group: 모델링에 사용된 모든 패밀리타입 코드 추출
name_3 = Element.Name(element=watch_all_elements_of_category)
uniqueItems_2 = List.UniqueItems(list=name_3@L2)
flatten_8 = List.Flatten(list=uniqueItems_2)
watch_15 = Watch(flatten_8)
code_block_31 = CodeBlock { "_"; }
split = String.Split(str=watch_15, separator0=code_block_31)
firstItem = List.FirstItem(list=split@L2)

# group: 사용된 패밀리타입이 위치한 Column Index 추출
string_from_object_4 = FromObject(object=watch_14)
contains_2 = String.Contains(searchFor=firstItem, lacing=CrossProduct)  # unwired: str
map = List.Map(list=string_from_object_4, function=contains_2)
allFalse = List.AllFalse(list=map@L2)
code_block_32 = CodeBlock(i=allFalse) { i==false?true:false; }
code_block_33 = CodeBlock { true; }
allIndicesOf = List.AllIndicesOf(list=code_block_32, item=code_block_33)

# group: 사용된 패밀리타입 Column Data 추출
watch_16 = Watch(allIndicesOf)
getItemAtIndex = List.GetItemAtIndex(list=watch_12, index=watch_16)
code_block_34 = CodeBlock { 4; ""; }
# note: 불필요 정보 처리
replaceItemAtIndex = List.ReplaceItemAtIndex(list=getItemAtIndex@L2, index=code_block_34.out0, item=code_block_34.out1)
watch_17 = Watch(getItemAtIndex)

whole_data_row_direction = Object.Identity(object=watch_13)

# group: 사용된 패밀리 타입에서 세부코드가 기입된 Row 열 번호 추출
string_from_object_5 = FromObject(object=replaceItemAtIndex)
code_block_35 = CodeBlock { "000"; }
contains_3 = String.Contains(str=string_from_object_5@L2, searchFor=code_block_35, lacing=CrossProduct)
code_block_36 = CodeBlock { true; }
allIndicesOf_2 = List.AllIndicesOf(list=contains_3@L2, item=code_block_36)
watch_18 = Watch(allIndicesOf_2)

# group: WM code 추출
watch_19 = Watch(replaceItemAtIndex)
whole_data_row_direction_2 = Object.Identity(object=whole_data_row_direction)
getItemAtIndex_2 = List.GetItemAtIndex(list=whole_data_row_direction_2, index=watch_18@L2)
watch_20 = Watch(getItemAtIndex_2)
code_block_37 = CodeBlock { 0; }
getItemAtIndex_3 = List.GetItemAtIndex(list=watch_20@@L2, index=code_block_37)
watch_21 = Watch(getItemAtIndex_3)
getItemAtIndex_4 = List.GetItemAtIndex(list=watch_19@@L2, index=watch_18@L2)
watch_22 = Watch(getItemAtIndex_4)
code_block_38 = CodeBlock(i=watch_21, j=watch_22) { i + "-" + j; }
code_block_39 = CodeBlock { 3; }
getItemAtIndex_5 = List.GetItemAtIndex(list=watch_20@@L2, index=code_block_39)
watch_23 = Watch(getItemAtIndex_5)
code_block_40 = CodeBlock { 4; }
getItemAtIndex_6 = List.GetItemAtIndex(list=watch_20@@L2, index=code_block_40)
watch_24 = Watch(getItemAtIndex_6)
code_block_41 = CodeBlock(i=whole_data_row_direction_2) { i[3]; }
watch_25 = Watch(code_block_41)
code_block_42 = CodeBlock { 2; }
getItemAtIndex_7 = List.GetItemAtIndex(list=watch_20@@L2, index=code_block_42)
watch_26 = Watch(getItemAtIndex_7)

# group: Wall Type: WM Code 딕셔너리 생성(모델링에 포함 되지 않은 WM code 까지 포함되어야함)
code_block_43 = CodeBlock { 3; }
getItemAtIndex_8 = List.GetItemAtIndex(list=watch_19@L2, index=code_block_43)
code_block_44 = CodeBlock { "_"; "-"; }
split_2 = String.Split(str=getItemAtIndex_8, separator0=code_block_44.out0, separator1=code_block_44.out1)
firstItem_2 = List.FirstItem(list=split_2@L2)
byKeysValues = DesignScript.Builtin.Dictionary.ByKeysValues(keys=firstItem_2, values=code_block_38)
watch_27 = Watch(byKeysValues)

# group: material inform from excel sheet <per family type>
watch_28 = Watch(watch_27)

# group: material inform from excel sheet <per element>
name_4 = Element.Name(element=watch_all_elements_of_category_2)
keys = DesignScript.Builtin.Dictionary.Keys(dictionary=watch_28)
contains_4 = String.Contains(str=name_4, searchFor=keys, lacing=CrossProduct)
code_block_45 = CodeBlock { true; }
allIndicesOf_3 = List.AllIndicesOf(list=contains_4@L2, item=code_block_45)
flatten_9 = List.Flatten(list=allIndicesOf_3)
getItemAtIndex_9 = List.GetItemAtIndex(list=keys, index=flatten_9)
valueAtKey = DesignScript.Builtin.Dictionary.ValueAtKey(dictionary=watch_28, key=getItemAtIndex_9)

# group: WorkMaster 미포함 객체 제외(임시)
anyTrue = List.AnyTrue(list=contains_4@L2)
filterByBoolMask_7 = List.FilterByBoolMask(list=watch_all_elements_of_category_2, mask=anyTrue)

# group: WorkMaster 미포함 객체 제외(임시)
watch_workmaster_미포함_객체_제외_임시 = Watch(filterByBoolMask_7.in)

# group: material inform from modeling <per element>
getMaterials = Element.GetMaterials(element=filterByBoolMask_7.in)
name_5 = Element.Name(element=getMaterials)
code_block_46 = CodeBlock { "_"; }
split_3 = String.Split(str=name_5, separator0=code_block_46)
firstItem_3 = List.FirstItem(list=split_3@L2)
count = List.Count(list=getMaterials@L2)
chop = List.Chop(list=firstItem_3, lengths=count)

# group: 합집합
list_create_2 = List.Create(item0=chop, item1=valueAtKey)
transpose_2 = List.Transpose(lists=list_create_2)
watch_29 = Watch(transpose_2)
code_block_47 = CodeBlock { 1; }
flatten_10 = List.Flatten(list=watch_29@L3, amt=code_block_47)

# group: WM 중복제거
uniqueItems_3 = List.UniqueItems(list=flatten_10@L2)

# group: Total material index
watch_wm_중복제거 = Watch(uniqueItems_3)
flatten_11 = List.Flatten(list=watch_wm_중복제거)

# group: element별 material 개수로 함수 리스트 복제
ofRepeatedItem = List.OfRepeatedItem()  # unwired: item, amount
count_2 = List.Count(list=watch_wm_중복제거@L2)
laceShortest = List.LaceShortest(combineFunction=ofRepeatedItem, list0=watch_workmaster_미포함_객체_제외_임시, list1=count_2)
watch_30 = Watch(laceShortest)
flatten_12 = List.Flatten(list=watch_30)

# group: 함수 1
# note: target WM 입력부
code_block_48 = CodeBlock()
# ---------- code_block_48.designscript (5 lines) ----------
[
"A03AC032"
//,
//""
];
# ----------------------------------------
code_block_49 = CodeBlock { "Volume"; }
# note: 함수1 생성 구간
getParameterValueByName = Element.GetParameterValueByName(parameterName=code_block_49)  # unwired: element
function_compose = ComposeFunctions()  # frozen; unwired: function0, function1

# group: target WM 적용 함수 - element 매칭 구간
# note: 해당 함수의 target materials index 검색
contains_5 = String.Contains(str=flatten_11@L1, searchFor=code_block_48)
anyTrue_2 = List.AnyTrue(list=contains_5@L2)
code_block_50 = CodeBlock { true; }
# note: getting index of element which has target materials
allIndicesOf_4 = List.AllIndicesOf(list=anyTrue_2@L2, item=code_block_50)
flatten_13 = List.Flatten(list=allIndicesOf_4)
# note: wm 별 타겟 element 추출
getItemAtIndex_10 = List.GetItemAtIndex(list=flatten_12, index=flatten_13)
watch_31 = Watch(getItemAtIndex_10)
watch_material_index = Watch(flatten_11)
map_2 = List.Map()  # unwired: list, function
count_3 = List.Count(list=flatten_13)
# note: 필요한 개수로 함수 리스트 증식
ofRepeatedItem_2 = List.OfRepeatedItem(item=getParameterValueByName, amount=count_3)
watch_32 = Watch(ofRepeatedItem_2)
# note: 엘리먼트와 함수 1대1 매칭 적용
laceShortest_2 = List.LaceShortest(combineFunction=map_2, list0=watch_32, list1=watch_31)
count_4 = List.Count(list=laceShortest_2)

# group: FamilyName, WorkMasterCode, Quantities, Unit 결합구간
name_6 = Element.Name(element=watch_31)
watch_material_index_2 = Watch(watch_material_index)
getItemAtIndex_11 = List.GetItemAtIndex(list=watch_material_index_2, index=flatten_13)
flatten_14 = List.Flatten(list=laceShortest_2)
watch_33 = Watch(flatten_14)
code_block_51 = CodeBlock { "M3"; }
code_block_52 = CodeBlock(familyName=name_6, workmasterCode=getItemAtIndex_11, quantities=watch_33, unit=code_block_51) { familyName +"..."+ workmasterCode +"..."+ quantities +"..."+ unit; }

# group: Element Filter 적용구간-<element>
watch_element별_material_개수로_함수 = Watch(flatten_12)  # "Watch@element별 material 개수로 함수 리스트 복제"
name_7 = Element.Name(element=watch_element별_material_개수로_함수)
code_block_53 = CodeBlock { "FT112"; }
contains_6 = String.Contains(str=name_7, searchFor=code_block_53)
filterByBoolMask_8 = List.FilterByBoolMask(list=watch_element별_material_개수로_함수, mask=contains_6)
countTrue = List.CountTrue(list=contains_6)

# group: Element Filter 적용구간-<material>
watch_total_material_index = Watch(flatten_11)
filterByBoolMask_9 = List.FilterByBoolMask(list=watch_total_material_index, mask=contains_6)

# group: 함수 2-EXCAVATION for ISO FDN
# note: target WM 입력부
code_block_54 = CodeBlock()
# ---------- code_block_54.designscript (5 lines) ----------
[
"A01ZZ001"
//,
//""
];
# ----------------------------------------
code_block_55 = CodeBlock { "Area"; }
# note: 함수1 생성 구간
getParameterValueByName_2 = Element.GetParameterValueByName(parameterName=code_block_55)  # unwired: element
code_block_56 = CodeBlock { 2; }
mul = _ * code_block_56  # unwired: x
function_compose_2 = ComposeFunctions(function0=getParameterValueByName_2, function1=mul)

# group: target WM 적용 함수 - element 매칭 구간
# note: 해당 함수의 target materials index 검색
contains_7 = String.Contains(str=filterByBoolMask_9.in@L1, searchFor=code_block_54)
anyTrue_3 = List.AnyTrue(list=contains_7@L2)
code_block_57 = CodeBlock { true; }
# note: getting index of element which has target materials
allIndicesOf_5 = List.AllIndicesOf(list=anyTrue_3@L2, item=code_block_57)
flatten_15 = List.Flatten(list=allIndicesOf_5)
# note: wm 별 타겟 element 추출
getItemAtIndex_12 = List.GetItemAtIndex(list=filterByBoolMask_8.in, index=flatten_15)
# note: 필요한 개수로 함수 리스트 증식
watch_34 = Watch(getItemAtIndex_12)
watch_material_index_3 = Watch(filterByBoolMask_9.in)
map_3 = List.Map()  # unwired: list, function
count_5 = List.Count(list=flatten_15)
ofRepeatedItem_3 = List.OfRepeatedItem(item=function_compose_2, amount=count_5)
watch_35 = Watch(ofRepeatedItem_3)
# note: 엘리먼트와 함수 1대1 매칭 적용
laceShortest_3 = List.LaceShortest(combineFunction=map_3, list0=watch_35, list1=watch_34)
count_6 = List.Count(list=laceShortest_3)

# group: FamilyName, WorkMasterCode, Quantities, Unit 결합구간
name_8 = Element.Name(element=watch_34)
watch_material_index_4 = Watch(watch_material_index_3)
getItemAtIndex_13 = List.GetItemAtIndex(list=watch_material_index_4, index=flatten_15)
flatten_16 = List.Flatten(list=laceShortest_3)
watch_36 = Watch(flatten_16)
code_block_58 = CodeBlock { "M2"; }
code_block_59 = CodeBlock(familyName=name_8, workmasterCode=getItemAtIndex_13, quantities=watch_36, unit=code_block_58) { familyName +"..."+ workmasterCode +"..."+ quantities +"..."+ unit; }

# group: DATA 전처리
join_2 = List.Join(list0=code_block_52, list1=code_block_59)
code_block_60 = CodeBlock { "..."; }
split_4 = String.Split(str=join_2, separator0=code_block_60)
watch_37 = Watch(split_4)

# group: Export Excel(By OpenpyXl)
python_script_export_excel_by = Python(IN[0]=watch_37)  # "Python Script@Export Excel(By OpenpyXl)"; CPython3; frozen
# ---------- python_script_export_excel_by.python (151 lines) ----------
# Load the Python Standard and DesignScript Libraries
import sys
import os
#sys.path.append(r'C:\Users\HEC\AppData\Local\Programs\Python\Python39\Lib\site-packages')
#sys.path.append(r'C:\Users\pjmk0\AppData\Local\Programs\Python\Python39\Lib\site-packages')
sys.path.append(os.getenv('LOCALAPPDATA').replace('\\','\\\\') + r'\Programs\Python\Python39\Lib\site-packages')
import clr
clr.AddReference('ProtoGeometry')
from Autodesk.DesignScript.Geometry import *
from collections import Iterable

def iterable(obj):
    return isinstance(obj, Iterable)


# The inputs to this node will be stored as a list in the IN variables.
dataEnteringNode = IN
ListIn = IN[0]

# Place your code below this line
import datetime
from datetime import date, timedelta
Today = date.today()
import openpyxl
from openpyxl.styles import Border, Side, PatternFill, Font, GradientFill, Alignment, Color, numbers

sample_items = ListIn


def write_to_file(filepath):
    wb = openpyxl.Workbook()
    for sheet in wb.sheetnames:
        wb.remove(wb[sheet])

    thin = Side(border_style="thin", color="000000")
    double = Side(border_style="double", color="000000")

    ws = wb.create_sheet(title='Wall_Calc_instance', index=0)

    ws.merge_cells('A1:L1')
    ws['A1'] = 'HEC Wall Category Calculation Sheet'
    cell = ws['A1']
    cell.font = openpyxl.styles.Font(color='000000', size=20)
    cell.fill = openpyxl.styles.fills.PatternFill(patternType='solid',
                                                  fgColor=openpyxl.styles.colors.Color(rgb='fff3b0'))

    ws['A2'] = 'Item Number'
    ws['A2'].font = openpyxl.styles.Font(b=True, color='000000', size=12)
    #ws['B2'] = 'Member Name'
    #ws['B2'].font = openpyxl.styles.Font(b=True, color='000000', size=12)
    #ws['C2'] = 'Category'
    #ws['C2'].font = openpyxl.styles.Font(b=True, color='000000', size=12)
    ws['B2'] = 'Family Type'
    ws['B2'].font = openpyxl.styles.Font(b=True, color='000000', size=12)
    ws['C2'] = 'WorkMaster Code'
    ws['C2'].font = openpyxl.styles.Font(b=True, color='000000', size=12)
    #ws['F2'] = 'WorkMaster Description'
    #ws['F2'].font = openpyxl.styles.Font(b=True, color='000000', size=12)
    #ws['G2'] = 'Unit'
    #ws['G2'].font = openpyxl.styles.Font(b=True, color='000000', size=12)
    #ws['H2'] = '계수'
    #ws['H2'].font = openpyxl.styles.Font(b=True, color='000000', size=12)
    #ws['I2'] = '계산 참조값'
    #ws['I2'].font = openpyxl.styles.Font(b=True, color='000000', size=12)
    ws['D2'] = 'Quantities'
    ws['D2'].font = openpyxl.styles.Font(b=True, color='000000', size=12)
    ws['E2'] = 'Unit'
    ws['E2'].font = openpyxl.styles.Font(b=True, color='000000', size=12)
    ws['F2'] = 'Unit Price'
    ws['F2'].font = openpyxl.styles.Font(b=True, color='000000', size=12)
    ws['G2'] = 'Total Price'
    ws['G2'].font = openpyxl.styles.Font(b=True, color='000000', size=12)


## 칼럼별 너비 조정 구간
#    for col in range(ws.max_column):
#        ws.column_dimensions[chr(ord('A') + col)].width = 15
    ws.column_dimensions['A'].width = 15
    ws.column_dimensions['B'].width = 45
    ws.column_dimensions['C'].width = 60
    ws.column_dimensions['D'].width = 20
    ws.column_dimensions['E'].width = 20
    ws.column_dimensions['F'].width = 20
    ws.column_dimensions['G'].width = 20
    #ws.column_dimensions['G'].width = 9
    #ws.column_dimensions['H'].width = 9
    #ws.column_dimensions['H'].hidden = True
    #ws.column_dimensions['I'].width = 12
    #ws.column_dimensions['I'].hidden = True
    #ws.column_dimensions['J'].width = 12
    #ws.column_dimensions['K'].width = 12
    #ws.column_dimensions['L'].width = 12

###
    start_row = 3
    for (row, item) in enumerate(sample_items, start_row):
        cell = ws.cell(row=row, column=1, value=row - 2)
        cell.alignment = openpyxl.styles.Alignment(horizontal='center', vertical='center')

#        cell = ws.cell(row=row, column=2, value=item[0])
#        cell.number_format = openpyxl.styles.numbers.FORMAT_DATE_YYYYMMDD2  # 'yyyy-mm-dd'
        ws.cell(row=row, column=2, value=item[0]) ## Family Type 칼럼

        ws.cell(row=row, column=3, value=item[1]) ## WorkMaster Code 칼럼
        
        ws.cell(row=row, column=4, value=item[2]) ## Quantities 칼럼
        
        ws.cell(row=row, column=5, value=item[3]) ## Unit 칼럼
        
        #cell = ws.cell(row=row, column=8, value=item[6]) ## 계수 칼럼
        #cell.number_format = openpyxl.styles.numbers.builtin_format_code(3)  # '#,##0'
        
        #cell = ws.cell(row=row, column=9, value=item[7]) ## 계산 참조값 칼럼
        #cell.number_format = openpyxl.styles.numbers.builtin_format_code(3)  # '#,##0'
        
        #cell = ws.cell(row=row, column=10, value=item[8]) ## Quantities 칼럼
        #cell.number_format = openpyxl.styles.numbers.builtin_format_code(3)  # '#,##0'
        #cell.font = openpyxl.styles.Font(b=True, color='000000', size=11)

        cell = ws.cell(row=row, column=7, value='= D{current_row}*F{current_row}'.format(current_row=cell.row))
        cell.number_format = '#,##0'

#        cell = ws.cell(row=row, column=6, value='= D{current_row} * E{current_row}'.format(current_row=cell.row))
#        cell.number_format = openpyxl.styles.numbers.builtin_format_code(3)

    total_row = ws.max_row + 1
    if total_row > start_row:
        cell1 = ws.cell(row=total_row, column=6, value='Total')
        cell1.font = openpyxl.styles.Font(b=True, color='000000', size=15)
        
        cell2 = ws.cell(row=total_row, column=7, value='= SUM(G{}:G{})'.format(start_row, total_row - 1))
        cell2.number_format = openpyxl.styles.numbers.builtin_format_code(3)
        cell2.border = Border(top=double, left=double, right=double, bottom=double)
        cell2.font = openpyxl.styles.Font(b=True, color='ff03ce', size=15)
    

    wb.save(filepath)
    wb.close()


##if __name__ == '__main__':
#write_to_file('C:\\Users\\pjmk0\\AppData\\Roaming\\test.xlsx')

save_name = "HecWallCalcSheet_" + Today.strftime("%Y-%m-%d")+".xlsx"
path = os.getenv('APPDATA').replace('\\','\\\\')
filePath = path + '\\' + save_name

write_to_file(filePath)

# Assign your output to the OUT variable.
OUT = os.getenv('APPDATA')
# ----------------------------------------

code_block_61 = CodeBlock {  }

# group: material index_old
getMaterials_2 = Element.GetMaterials(element=all_elements_of_category_4)
flatten_17 = List.Flatten(list=getMaterials_2)
name_9 = Element.Name(element=flatten_17)

uniqueItems_4 = List.UniqueItems(list=name_9)

# group: Row Index Guide
code_block_62 = CodeBlock(i=watch_12) { i[3]; }
watch_38 = Watch(code_block_62)

# group: C. Category
code_block_63 = CodeBlock { "Category"; }
getParameterValueByName_3 = Element.GetParameterValueByName(element=watch_all_elements_of_category, parameterName=code_block_63)

name_10 = Element.Name(element=getMaterials_2@L2)
code_block_64 = CodeBlock {  }
byKeysValues_2 = DesignScript.Builtin.Dictionary.ByKeysValues(keys=firstItem_2)  # unwired: values
count_7 = List.Count(list=watch_wm_중복제거@L2)
faces_2 = Element.Faces(element=filterByBoolMask_8.in)
flatten_18 = List.Flatten(list=faces_2)
code_block_65 = CodeBlock { 0.5; }
normalAtParameter_5 = Surface.NormalAtParameter(surface=flatten_18, u=code_block_65, v=code_block_65)
Z_5 = Vector.Z(vector=normalAtParameter_5)
code_block_66 = CodeBlock(i=Z_5) { i == -1; }
filterByBoolMask_10 = List.FilterByBoolMask(list=flatten_18, mask=code_block_66)
watch_39 = Watch(filterByBoolMask_10.in)
perimeterCurves_6 = Surface.PerimeterCurves(surface=watch_39)
byJoinedCurves = PolyCurve.ByJoinedCurves(curves=perimeterCurves_6)
code_block_67 = CodeBlock { 100; }
code_block_68 = CodeBlock { false; }
offset_5 = PolyCurve.Offset(polyCurve=byJoinedCurves, signedDistance=code_block_67, extendCircular=code_block_68)
code_block_69 = CodeBlock { 1500; }
translate_2 = Geometry.Translate(geometry=offset_5, zTranslation=code_block_69)
code_block_70 = CodeBlock { 500; }
code_block_71 = CodeBlock { false; }
offset_6 = PolyCurve.Offset(polyCurve=translate_2, signedDistance=code_block_70, extendCircular=code_block_71)
list_create_3 = List.Create(item0=offset_5, item1=offset_6)
transpose_3 = List.Transpose(lists=list_create_3)
byLoft_2 = Solid.ByLoft(crossSections=transpose_3)
