# Dynamo graph Str Foundation Calculator_HEC(0713).dyn (Dynamo 2.10.1.3976)

# group: All Elements of Category - STR FDN
categories = Categories("OST_StructuralFoundation")  # graph input
all_elements_of_category = ElementsOfCategory(Category=categories)

# group: All Elements of Category
watch_all_elements_of_category = Watch(all_elements_of_category)  # "Watch@All Elements of Category - WALLS"

# group: D. Family Type
watch_all_elements_of_category_2 = Watch(watch_all_elements_of_category)  # "Watch@All Elements of Category - WALLS"
name = Element.Name(element=watch_all_elements_of_category_2)

# group: Excel Import
file_path = Filename("..\Structural Foundation 물량산출용 파일\BIM_물량집계 자동화 산출기준표_Str Foundation.xlsx")
file_from_path = FileObject(path=file_path)
string_from_object = FromObject(object=file_from_path)
code_block = CodeBlock { "Scope_lv2(Str Foundations)"; }
python_script_import_excel_by = Python(IN[0]=string_from_object, IN[1]=code_block)  # "Python Script@Import Excel(By OpenpyXl)"; CPython3
# ---------- python_script_import_excel_by.python (50 lines) ----------
# Load the Python Standard and DesignScript Libraries
import sys
import os
#sys.path.append(r'C:\Users\HEC\AppData\Local\Programs\Python\Python39\Lib\site-packages')
#sys.path.append(r'C:\Users\pjmk0\AppData\Local\Programs\Python\Python39\Lib\site-packages')
sys.path.append(os.getenv('LOCALAPPDATA').replace('\\','\\\\') + r'\Programs\Python\Python39\Lib\site-packages')
import clr
clr.AddReference('ProtoGeometry')
from Autodesk.DesignScript.Geometry import *
from collections import Iterable

def iterable(obj):
    return isinstance(obj, Iterable)


# The inputs to this node will be stored as a list in the IN variables.
dataEnteringNode = IN
PathIn = IN[0]
SheetNameIn = IN[1]

# Place your code below this line
import datetime
import openpyxl

path = (PathIn)
#path = (r'C:\Users\pjmk0\Downloads\MK\mQ\BIM_물량집계 자동화 산출기준표_rC(20210607)_mk_de.xlsx')

wb_obj = openpyxl.load_workbook(path, data_only=True)
sheet_obj = wb_obj.get_sheet_by_name(SheetNameIn)

m_row = sheet_obj.max_row
m_col = sheet_obj.max_column

listOut = []



for i in range(1, m_row +1):
    listTemp = []
    for j in range(1, m_col + 1):
        cell_obj = sheet_obj.cell(row=i, column=j)
        listTemp.append(cell_obj.value)
        if len(listTemp) == m_col:
            listOut.append(listTemp)
        


# Assign your output to the OUT variable.
OUT = listOut
#OUT = os.getenv('APPDATA')
# ----------------------------------------
code_block_2 = CodeBlock { false; }
importExcel = Data.ImportExcel(file=file_from_path, sheetName=code_block, showExcel=code_block_2)  # frozen

# group: Null값 처리
code_block_3 = CodeBlock { " "; }
isNull = Object.IsNull()  # unwired: object
replaceByCondition = Replace(item=python_script_import_excel_by, replaceWith=code_block_3, condition=isNull)

# group: Whole Data(Column direction)
transpose = List.Transpose(lists=replaceByCondition)
watch = Watch(transpose)

# group: Whole Data(row direction)
watch_2 = Watch(replaceByCondition)

# group: Column Index Guide
code_block_4 = CodeBlock(i=watch_2) { i[3]; }
watch_3 = Watch(code_block_4)

# group: 모델링에 사용된 모든 패밀리타입 코드 추출
name_2 = Element.Name(element=watch_all_elements_of_category)
uniqueItems = List.UniqueItems(list=name_2@L2)
flatten = List.Flatten(list=uniqueItems)
watch_4 = Watch(flatten)
code_block_5 = CodeBlock { "_"; }
split = String.Split(str=watch_4, separator0=code_block_5)
firstItem = List.FirstItem(list=split@L2)

# group: 사용된 패밀리타입이 위치한 Column Index 추출
string_from_object_2 = FromObject(object=watch_3)
contains = String.Contains(searchFor=firstItem, lacing=CrossProduct)  # unwired: str
map = List.Map(list=string_from_object_2, function=contains)
allFalse = List.AllFalse(list=map@L2)
code_block_6 = CodeBlock(i=allFalse) { i==false?true:false; }
code_block_7 = CodeBlock { true; }
allIndicesOf = List.AllIndicesOf(list=code_block_6, item=code_block_7)

# group: 사용된 패밀리타입 Column Data 추출
watch_5 = Watch(allIndicesOf)
getItemAtIndex = List.GetItemAtIndex(list=watch, index=watch_5)
code_block_8 = CodeBlock { 4; ""; }
# note: 불필요 정보 처리
replaceItemAtIndex = List.ReplaceItemAtIndex(list=getItemAtIndex@L2, index=code_block_8.out0, item=code_block_8.out1)
watch_6 = Watch(getItemAtIndex)

whole_data_row_direction = Object.Identity(object=watch_2)

# group: 사용된 패밀리 타입에서 세부코드가 기입된 Row 열 번호 추출
string_from_object_3 = FromObject(object=replaceItemAtIndex)
code_block_9 = CodeBlock { "000"; }
contains_2 = String.Contains(str=string_from_object_3@L2, searchFor=code_block_9, lacing=CrossProduct)
code_block_10 = CodeBlock { true; }
allIndicesOf_2 = List.AllIndicesOf(list=contains_2@L2, item=code_block_10)
watch_7 = Watch(allIndicesOf_2)

# group: WM code 추출
watch_8 = Watch(replaceItemAtIndex)
whole_data_row_direction_2 = Object.Identity(object=whole_data_row_direction)
getItemAtIndex_2 = List.GetItemAtIndex(list=whole_data_row_direction_2, index=watch_7@L2)
watch_9 = Watch(getItemAtIndex_2)
code_block_11 = CodeBlock { 0; }
getItemAtIndex_3 = List.GetItemAtIndex(list=watch_9@@L2, index=code_block_11)
watch_10 = Watch(getItemAtIndex_3)
getItemAtIndex_4 = List.GetItemAtIndex(list=watch_8@@L2, index=watch_7@L2)
watch_11 = Watch(getItemAtIndex_4)
code_block_12 = CodeBlock(i=watch_10, j=watch_11) { i + "-" + j; }
code_block_13 = CodeBlock { 3; }
getItemAtIndex_5 = List.GetItemAtIndex(list=watch_9@@L2, index=code_block_13)
watch_12 = Watch(getItemAtIndex_5)
code_block_14 = CodeBlock { 4; }
getItemAtIndex_6 = List.GetItemAtIndex(list=watch_9@@L2, index=code_block_14)
watch_13 = Watch(getItemAtIndex_6)
code_block_15 = CodeBlock(i=whole_data_row_direction_2) { i[3]; }
watch_14 = Watch(code_block_15)
code_block_16 = CodeBlock { 2; }
getItemAtIndex_7 = List.GetItemAtIndex(list=watch_9@@L2, index=code_block_16)
watch_15 = Watch(getItemAtIndex_7)

# group: Family Type: WM Code 딕셔너리 생성(모델링에 포함 되지 않은 WM code 까지 포함되어야함)
code_block_17 = CodeBlock { 3; }
getItemAtIndex_8 = List.GetItemAtIndex(list=watch_8@L2, index=code_block_17)
code_block_18 = CodeBlock { "_"; "-"; }
split_2 = String.Split(str=getItemAtIndex_8, separator0=code_block_18.out0, separator1=code_block_18.out1)
firstItem_2 = List.FirstItem(list=split_2@L2)
byKeysValues = DesignScript.Builtin.Dictionary.ByKeysValues(keys=firstItem_2, values=code_block_12)
watch_16 = Watch(byKeysValues)
byKeysValues_2 = DesignScript.Builtin.Dictionary.ByKeysValues(keys=firstItem_2)  # unwired: values

# group: material inform from excel sheet <per family type>
watch_17 = Watch(watch_16)

# group: material inform from excel sheet <per element>
name_3 = Element.Name(element=watch_all_elements_of_category_2)
keys = DesignScript.Builtin.Dictionary.Keys(dictionary=watch_17)
contains_3 = String.Contains(str=name_3, searchFor=keys, lacing=CrossProduct)
code_block_19 = CodeBlock { true; }
allIndicesOf_3 = List.AllIndicesOf(list=contains_3@L2, item=code_block_19)
flatten_2 = List.Flatten(list=allIndicesOf_3)
getItemAtIndex_9 = List.GetItemAtIndex(list=keys, index=flatten_2)
valueAtKey = DesignScript.Builtin.Dictionary.ValueAtKey(dictionary=watch_17, key=getItemAtIndex_9)

# group: WorkMaster 미포함 객체 제외(임시)
anyTrue = List.AnyTrue(list=contains_3@L2)
filterByBoolMask = List.FilterByBoolMask(list=watch_all_elements_of_category_2, mask=anyTrue)

# group: WorkMaster 미포함 객체 제외(임시)
watch_workmaster_미포함_객체_제외_임시 = Watch(filterByBoolMask.in)

# group: material inform from modeling <per element>
getMaterials = Element.GetMaterials(element=filterByBoolMask.in)
name_4 = Element.Name(element=getMaterials)
code_block_20 = CodeBlock { "_"; }
split_3 = String.Split(str=name_4, separator0=code_block_20)
firstItem_3 = List.FirstItem(list=split_3@L2)
count = List.Count(list=getMaterials@L2)
chop = List.Chop(list=firstItem_3, lengths=count)

# group: 합집합
list_create = List.Create(item0=chop, item1=valueAtKey)
transpose_2 = List.Transpose(lists=list_create)
watch_18 = Watch(transpose_2)
code_block_21 = CodeBlock { 1; }
flatten_3 = List.Flatten(list=watch_18@L3, amt=code_block_21)

# group: WM 중복제거
uniqueItems_2 = List.UniqueItems(list=flatten_3@L2)

# group: Total material index
watch_wm_중복제거 = Watch(uniqueItems_2)
flatten_4 = List.Flatten(list=watch_wm_중복제거)

# group: element별 material 개수로 함수 리스트 복제
ofRepeatedItem = List.OfRepeatedItem()  # unwired: item, amount
count_2 = List.Count(list=watch_wm_중복제거@L2)
laceShortest = List.LaceShortest(combineFunction=ofRepeatedItem, list0=watch_workmaster_미포함_객체_제외_임시, list1=count_2)
watch_19 = Watch(laceShortest)
flatten_5 = List.Flatten(list=watch_19)

# group: Element Filter 적용구간-<element>
watch_element별_material_개수로_함수 = Watch(flatten_5)  # "Watch@element별 material 개수로 함수 리스트 복제"
name_5 = Element.Name(element=watch_element별_material_개수로_함수)
code_block_22 = CodeBlock { ""; }
contains_4 = String.Contains(str=name_5, searchFor=code_block_22)
filterByBoolMask_2 = List.FilterByBoolMask(list=watch_element별_material_개수로_함수, mask=contains_4)
countTrue = List.CountTrue(list=contains_4)

# group: Element Filter 적용구간-<material>
watch_total_material_index = Watch(flatten_4)
filterByBoolMask_3 = List.FilterByBoolMask(list=watch_total_material_index, mask=contains_4)

# group: 함수 1-Concrete [cat.1]
# note: target WM 입력부
code_block_23 = CodeBlock()
# ---------- code_block_23.designscript (5 lines) ----------
[
"A03AC032"
//,
//""
];
# ----------------------------------------
code_block_24 = CodeBlock { "Volume"; }
# note: 함수1 생성 구간
getParameterValueByName = Element.GetParameterValueByName(parameterName=code_block_24)  # unwired: element
function_compose = ComposeFunctions(function0=getParameterValueByName)  # frozen; unwired: function1
code_block_25 = CodeBlock {  }

# group: target WM 적용 함수 - element 매칭 구간
# note: 해당 함수의 target materials index 검색
contains_5 = String.Contains(str=filterByBoolMask_3.in@L1, searchFor=code_block_23)
anyTrue_2 = List.AnyTrue(list=contains_5@L2)
code_block_26 = CodeBlock { true; }
# note: getting index of element which has target materials
allIndicesOf_4 = List.AllIndicesOf(list=anyTrue_2@L2, item=code_block_26)
flatten_6 = List.Flatten(list=allIndicesOf_4)
# note: wm 별 타겟 element 추출
getItemAtIndex_10 = List.GetItemAtIndex(list=filterByBoolMask_2.in, index=flatten_6)
watch_20 = Watch(getItemAtIndex_10)
watch_material_index = Watch(filterByBoolMask_3.in)
map_2 = List.Map()  # unwired: list, function
count_3 = List.Count(list=flatten_6)
# note: 필요한 개수로 함수 리스트 증식
ofRepeatedItem_2 = List.OfRepeatedItem(item=getParameterValueByName, amount=count_3)
watch_21 = Watch(ofRepeatedItem_2)
# note: 엘리먼트와 함수 1대1 매칭 적용
laceShortest_2 = List.LaceShortest(combineFunction=map_2, list0=watch_21, list1=watch_20)
count_4 = List.Count(list=laceShortest_2)

# group: FamilyName, WorkMasterCode, Quantities, Unit 결합구간
name_6 = Element.Name(element=watch_20)
watch_material_index_2 = Watch(watch_material_index)
getItemAtIndex_11 = List.GetItemAtIndex(list=watch_material_index_2, index=flatten_6)
flatten_7 = List.Flatten(list=laceShortest_2)
watch_22 = Watch(flatten_7)
code_block_27 = CodeBlock { "M3"; }
code_block_28 = CodeBlock(familyName=name_6, workmasterCode=getItemAtIndex_11, quantities=watch_22, unit=code_block_27) { familyName +"..."+ workmasterCode +"..."+ quantities +"..."+ unit; }

# group: Element Filter 적용구간-<element>
watch_element별_material_개수로_함수_2 = Watch(flatten_5)  # "Watch@element별 material 개수로 함수 리스트 복제"
name_7 = Element.Name(element=watch_element별_material_개수로_함수_2)
code_block_29 = CodeBlock { "FT112"; }
contains_6 = String.Contains(str=name_7, searchFor=code_block_29)
filterByBoolMask_4 = List.FilterByBoolMask(list=watch_element별_material_개수로_함수_2, mask=contains_6)
countTrue_2 = List.CountTrue(list=contains_6)

# group: Element Filter 적용구간-<material>
watch_total_material_index_2 = Watch(flatten_4)
filterByBoolMask_5 = List.FilterByBoolMask(list=watch_total_material_index_2, mask=contains_6)

# group: 함수 2-EXCAVATION for ISO FDN [cat.3]
# note: target WM 입력부
code_block_30 = CodeBlock()
# ---------- code_block_30.designscript (5 lines) ----------
[
"A01ZZ001"
//,
//""
];
# ----------------------------------------
faces = Element.Faces(element=filterByBoolMask_4.in)
flatten_8 = List.Flatten(list=faces)
code_block_31 = CodeBlock { 0.5; }
normalAtParameter = Surface.NormalAtParameter(surface=flatten_8, u=code_block_31, v=code_block_31)
Z = Vector.Z(vector=normalAtParameter)
code_block_32 = CodeBlock(i=Z) { i == -1; }
filterByBoolMask_6 = List.FilterByBoolMask(list=flatten_8, mask=code_block_32)
watch_23 = Watch(filterByBoolMask_6.in)
perimeterCurves = Surface.PerimeterCurves(surface=watch_23)
byJoinedCurves = PolyCurve.ByJoinedCurves(curves=perimeterCurves)
code_block_33 = CodeBlock { 300; }
code_block_34 = CodeBlock { false; }
offset = PolyCurve.Offset(polyCurve=byJoinedCurves, signedDistance=code_block_33, extendCircular=code_block_34)
code_block_35 = CodeBlock { 1500; }
translate = Geometry.Translate(geometry=offset, zTranslation=code_block_35)
code_block_36 = CodeBlock { 700; }
code_block_37 = CodeBlock { false; }
# note: 함수1 생성 구간
offset_2 = PolyCurve.Offset(polyCurve=translate, signedDistance=code_block_36, extendCircular=code_block_37)
list_create_2 = List.Create(item0=offset, item1=offset_2)
transpose_3 = List.Transpose(lists=list_create_2)
byLoft = Solid.ByLoft(crossSections=transpose_3)
volume = Solid.Volume(solid=byLoft)

# group: target WM 적용 함수 - element 매칭 구간
# note: 해당 함수의 target materials index 검색
contains_7 = String.Contains(str=filterByBoolMask_5.in@L1, searchFor=code_block_30)
anyTrue_3 = List.AnyTrue(list=contains_7@L2)
code_block_38 = CodeBlock { true; }
# note: getting index of element which has target materials
allIndicesOf_5 = List.AllIndicesOf(list=anyTrue_3@L2, item=code_block_38)
flatten_9 = List.Flatten(list=allIndicesOf_5)
# note: wm 별 타겟 element 추출
getItemAtIndex_12 = List.GetItemAtIndex(list=filterByBoolMask_4.in, index=flatten_9)
# note: 필요한 개수로 함수 리스트 증식
# note: 엘리먼트와 함수 1대1 매칭 적용
watch_24 = Watch(getItemAtIndex_12)
watch_material_index_3 = Watch(filterByBoolMask_5.in)
count_5 = List.Count(list=flatten_9)

getItemAtIndex_13 = List.GetItemAtIndex(list=volume, index=flatten_9)
watch_25 = Watch(getItemAtIndex_13)

# group: FamilyName, WorkMasterCode, Quantities, Unit 결합구간
name_8 = Element.Name(element=watch_24)
watch_material_index_4 = Watch(watch_material_index_3)
getItemAtIndex_14 = List.GetItemAtIndex(list=watch_material_index_4, index=flatten_9)
flatten_10 = List.Flatten(list=watch_25)
watch_26 = Watch(flatten_10)
code_block_39 = CodeBlock { "M3"; }
code_block_40 = CodeBlock(familyName=name_8, workmasterCode=getItemAtIndex_14, quantities=watch_26, unit=code_block_39) { familyName +"..."+ workmasterCode +"..."+ quantities/1000000000 +"..."+ unit; }

# group: Element Filter 적용구간-<element>
watch_element별_material_개수로_함수_3 = Watch(flatten_5)  # "Watch@element별 material 개수로 함수 리스트 복제"
name_9 = Element.Name(element=watch_element별_material_개수로_함수_3)
code_block_41 = CodeBlock { "FT112"; }
contains_8 = String.Contains(str=name_9, searchFor=code_block_41)
filterByBoolMask_7 = List.FilterByBoolMask(list=watch_element별_material_개수로_함수_3, mask=contains_8)
countTrue_3 = List.CountTrue(list=contains_8)

# group: Element Filter 적용구간-<material>
watch_total_material_index_3 = Watch(flatten_4)
filterByBoolMask_8 = List.FilterByBoolMask(list=watch_total_material_index_3, mask=contains_8)

# group: 함수 3-Lean Conc for ISO FDN [cat.3]
# note: target WM 입력부
code_block_42 = CodeBlock()
# ---------- code_block_42.designscript (5 lines) ----------
[
"A03AC034"
//,
//""
];
# ----------------------------------------
faces_2 = Element.Faces(element=filterByBoolMask_7.in)
flatten_11 = List.Flatten(list=faces_2)
code_block_43 = CodeBlock { 0.5; }
normalAtParameter_2 = Surface.NormalAtParameter(surface=flatten_11, u=code_block_43, v=code_block_43)
Z_2 = Vector.Z(vector=normalAtParameter_2)
code_block_44 = CodeBlock(i=Z_2) { i == -1; }
filterByBoolMask_9 = List.FilterByBoolMask(list=flatten_11, mask=code_block_44)
watch_27 = Watch(filterByBoolMask_9.in)
perimeterCurves_2 = Surface.PerimeterCurves(surface=watch_27)
byJoinedCurves_2 = PolyCurve.ByJoinedCurves(curves=perimeterCurves_2)
code_block_45 = CodeBlock { 100; }
code_block_46 = CodeBlock { false; }
offset_3 = PolyCurve.Offset(polyCurve=byJoinedCurves_2, signedDistance=code_block_45, extendCircular=code_block_46)
code_block_47 = CodeBlock { -100; }
translate_2 = Geometry.Translate(geometry=offset_3, zTranslation=code_block_47)
# note: 함수1 생성 구간
list_create_3 = List.Create(item0=offset_3, item1=translate_2)
transpose_4 = List.Transpose(lists=list_create_3)
byLoft_2 = Solid.ByLoft(crossSections=transpose_4)
volume_2 = Solid.Volume(solid=byLoft_2)
code_block_48 = CodeBlock { 500; }
code_block_49 = CodeBlock { false; }

# group: target WM 적용 함수 - element 매칭 구간
# note: 해당 함수의 target materials index 검색
contains_9 = String.Contains(str=filterByBoolMask_8.in@L1, searchFor=code_block_42)
anyTrue_4 = List.AnyTrue(list=contains_9@L2)
code_block_50 = CodeBlock { true; }
# note: getting index of element which has target materials
allIndicesOf_6 = List.AllIndicesOf(list=anyTrue_4@L2, item=code_block_50)
flatten_12 = List.Flatten(list=allIndicesOf_6)
# note: wm 별 타겟 element 추출
getItemAtIndex_15 = List.GetItemAtIndex(list=filterByBoolMask_7.in, index=flatten_12)
# note: 필요한 개수로 함수 리스트 증식
# note: 엘리먼트와 함수 1대1 매칭 적용
watch_28 = Watch(getItemAtIndex_15)
watch_material_index_5 = Watch(filterByBoolMask_8.in)
count_6 = List.Count(list=flatten_12)

getItemAtIndex_16 = List.GetItemAtIndex(list=volume_2, index=flatten_12)
watch_29 = Watch(getItemAtIndex_16)

# group: FamilyName, WorkMasterCode, Quantities, Unit 결합구간
name_10 = Element.Name(element=watch_28)
watch_material_index_6 = Watch(watch_material_index_5)
getItemAtIndex_17 = List.GetItemAtIndex(list=watch_material_index_6, index=flatten_12)
flatten_13 = List.Flatten(list=watch_29)
watch_30 = Watch(flatten_13)
code_block_51 = CodeBlock { "M3"; }
code_block_52 = CodeBlock(familyName=name_10, workmasterCode=getItemAtIndex_17, quantities=watch_30, unit=code_block_51) { familyName +"..."+ workmasterCode +"..."+ quantities/1000000000 +"..."+ unit; }

# group: Element Filter 적용구간-<element>
watch_element별_material_개수로_함수_4 = Watch(flatten_5)  # "Watch@element별 material 개수로 함수 리스트 복제"
name_11 = Element.Name(element=watch_element별_material_개수로_함수_4)
code_block_53 = CodeBlock { "FT112"; }
contains_10 = String.Contains(str=name_11, searchFor=code_block_53)
filterByBoolMask_10 = List.FilterByBoolMask(list=watch_element별_material_개수로_함수_4, mask=contains_10)
countTrue_4 = List.CountTrue(list=contains_10)

# group: Element Filter 적용구간-<material>
watch_total_material_index_4 = Watch(flatten_4)
filterByBoolMask_11 = List.FilterByBoolMask(list=watch_total_material_index_4, mask=contains_10)

# group: 함수 4-Base Course for ISO FDN [cat.3]
# note: target WM 입력부
code_block_54 = CodeBlock()
# ---------- code_block_54.designscript (5 lines) ----------
[
"A01ZZ005"
//,
//""
];
# ----------------------------------------
faces_3 = Element.Faces(element=filterByBoolMask_10.in)
flatten_14 = List.Flatten(list=faces_3)
code_block_55 = CodeBlock { 0.5; }
normalAtParameter_3 = Surface.NormalAtParameter(surface=flatten_14, u=code_block_55, v=code_block_55)
Z_3 = Vector.Z(vector=normalAtParameter_3)
code_block_56 = CodeBlock(i=Z_3) { i == -1; }
filterByBoolMask_12 = List.FilterByBoolMask(list=flatten_14, mask=code_block_56)
watch_31 = Watch(filterByBoolMask_12.in)
perimeterCurves_3 = Surface.PerimeterCurves(surface=watch_31)
byJoinedCurves_3 = PolyCurve.ByJoinedCurves(curves=perimeterCurves_3)
code_block_57 = CodeBlock { 300; }
code_block_58 = CodeBlock { false; }
offset_4 = PolyCurve.Offset(polyCurve=byJoinedCurves_3, signedDistance=code_block_57, extendCircular=code_block_58)
code_block_59 = CodeBlock { -100; }
translate_3 = Geometry.Translate(geometry=offset_4, zTranslation=code_block_59)
code_block_60 = CodeBlock { -200; }
# note: 함수1 생성 구간
translate_4 = Geometry.Translate(geometry=translate_3, zTranslation=code_block_60)
list_create_4 = List.Create(item0=translate_3, item1=translate_4)
lastItem = List.LastItem(list=list_create_4)
byPatch = Surface.ByPatch(closedCurve=lastItem)
area = Surface.Area(surface=byPatch)
code_block_61 = CodeBlock { 500; }
code_block_62 = CodeBlock { false; }
transpose_5 = List.Transpose(lists=list_create_4)
byLoft_3 = Solid.ByLoft(crossSections=transpose_5)
volume_3 = Solid.Volume(solid=byLoft_3)

# group: target WM 적용 함수 - element 매칭 구간
# note: 해당 함수의 target materials index 검색
contains_11 = String.Contains(str=filterByBoolMask_11.in@L1, searchFor=code_block_54)
anyTrue_5 = List.AnyTrue(list=contains_11@L2)
code_block_63 = CodeBlock { true; }
# note: getting index of element which has target materials
allIndicesOf_7 = List.AllIndicesOf(list=anyTrue_5@L2, item=code_block_63)
flatten_15 = List.Flatten(list=allIndicesOf_7)
# note: wm 별 타겟 element 추출
getItemAtIndex_18 = List.GetItemAtIndex(list=filterByBoolMask_10.in, index=flatten_15)
# note: 필요한 개수로 함수 리스트 증식
# note: 엘리먼트와 함수 1대1 매칭 적용
watch_32 = Watch(getItemAtIndex_18)
watch_material_index_7 = Watch(filterByBoolMask_11.in)
count_7 = List.Count(list=flatten_15)

getItemAtIndex_19 = List.GetItemAtIndex(list=area, index=flatten_15)
watch_33 = Watch(getItemAtIndex_19)

# group: FamilyName, WorkMasterCode, Quantities, Unit 결합구간
name_12 = Element.Name(element=watch_32)
watch_material_index_8 = Watch(watch_material_index_7)
getItemAtIndex_20 = List.GetItemAtIndex(list=watch_material_index_8, index=flatten_15)
flatten_16 = List.Flatten(list=watch_33)
watch_34 = Watch(flatten_16)
code_block_64 = CodeBlock { "M2"; }
code_block_65 = CodeBlock(familyName=name_12, workmasterCode=getItemAtIndex_20, quantities=watch_34, unit=code_block_64) { familyName +"..."+ workmasterCode +"..."+ quantities/1000000 +"..."+ unit; }

# group: Element Filter 적용구간-<element>
watch_element별_material_개수로_함수_5 = Watch(flatten_5)  # "Watch@element별 material 개수로 함수 리스트 복제"
name_13 = Element.Name(element=watch_element별_material_개수로_함수_5)
code_block_66 = CodeBlock { "FT112"; }
contains_12 = String.Contains(str=name_13, searchFor=code_block_66)
filterByBoolMask_13 = List.FilterByBoolMask(list=watch_element별_material_개수로_함수_5, mask=contains_12)
countTrue_5 = List.CountTrue(list=contains_12)

# group: Element Filter 적용구간-<material>
watch_total_material_index_5 = Watch(flatten_4)
filterByBoolMask_14 = List.FilterByBoolMask(list=watch_total_material_index_5, mask=contains_12)

# group: 함수 5-FormWork for ISO FDN [cat.3]
# note: target WM 입력부
code_block_67 = CodeBlock()
# ---------- code_block_67.designscript (5 lines) ----------
[
"A03AC035"
//,
//""
];
# ----------------------------------------
faces_4 = Element.Faces(element=filterByBoolMask_13.in)
code_block_68 = CodeBlock { 0.5; }
normalAtParameter_4 = Surface.NormalAtParameter(surface=faces_4, u=code_block_68, v=code_block_68)
Z_4 = Vector.Z(vector=normalAtParameter_4)
code_block_69 = CodeBlock(i=Z_4) { i != -1 && i != 1; }
filterByBoolMask_15 = List.FilterByBoolMask(list=faces_4, mask=code_block_69)
# note: 함수1 생성 구간
watch_35 = Watch(filterByBoolMask_15.in)
area_2 = Surface.Area(surface=watch_35)
flatten_17 = List.Flatten(list=faces_4)

# group: target WM 적용 함수 - element 매칭 구간
# note: 해당 함수의 target materials index 검색
contains_13 = String.Contains(str=filterByBoolMask_14.in@L1, searchFor=code_block_67)
anyTrue_6 = List.AnyTrue(list=contains_13@L2)
code_block_70 = CodeBlock { true; }
# note: getting index of element which has target materials
allIndicesOf_8 = List.AllIndicesOf(list=anyTrue_6@L2, item=code_block_70)
flatten_18 = List.Flatten(list=allIndicesOf_8)
# note: wm 별 타겟 element 추출
getItemAtIndex_21 = List.GetItemAtIndex(list=filterByBoolMask_13.in, index=flatten_18)
# note: 필요한 개수로 함수 리스트 증식
# note: 엘리먼트와 함수 1대1 매칭 적용
watch_36 = Watch(getItemAtIndex_21)
watch_material_index_9 = Watch(filterByBoolMask_14.in)
count_8 = List.Count(list=flatten_18)

sum = Math.Sum(values=area_2@L2)
getItemAtIndex_22 = List.GetItemAtIndex(list=sum, index=flatten_18)
watch_37 = Watch(getItemAtIndex_22)

# group: FamilyName, WorkMasterCode, Quantities, Unit 결합구간
name_14 = Element.Name(element=watch_36)
watch_material_index_10 = Watch(watch_material_index_9)
getItemAtIndex_23 = List.GetItemAtIndex(list=watch_material_index_10, index=flatten_18)
flatten_19 = List.Flatten(list=watch_37)
watch_38 = Watch(flatten_19)
code_block_71 = CodeBlock { "M2"; }
code_block_72 = CodeBlock(familyName=name_14, workmasterCode=getItemAtIndex_23, quantities=watch_38, unit=code_block_71) { familyName +"..."+ workmasterCode +"..."+ quantities/1000000 +"..."+ unit; }

# group: Element Filter 적용구간-<element>
watch_element별_material_개수로_함수_6 = Watch(flatten_5)  # "Watch@element별 material 개수로 함수 리스트 복제"
name_15 = Element.Name(element=watch_element별_material_개수로_함수_6)
code_block_73 = CodeBlock { ""; }
contains_14 = String.Contains(str=name_15, searchFor=code_block_73)
filterByBoolMask_16 = List.FilterByBoolMask(list=watch_element별_material_개수로_함수_6, mask=contains_14)
countTrue_6 = List.CountTrue(list=contains_14)

# group: Element Filter 적용구간-<material>
watch_total_material_index_6 = Watch(flatten_4)
filterByBoolMask_17 = List.FilterByBoolMask(list=watch_total_material_index_6, mask=contains_14)

code_block_74 = CodeBlock { 0.1; }
mul = _ * code_block_74  # unwired: x

# group: 함수 6-Rebar [cat.2]
# note: target WM 입력부
code_block_75 = CodeBlock()
# ---------- code_block_75.designscript (5 lines) ----------
[
"A03AC037"
//,
//""
];
# ----------------------------------------
code_block_76 = CodeBlock { "Volume"; }
# note: 함수1 생성 구간
getParameterValueByName_2 = Element.GetParameterValueByName(parameterName=code_block_76)  # unwired: element
function_compose_2 = ComposeFunctions(function0=getParameterValueByName_2, function1=mul)
code_block_77 = CodeBlock {  }

# group: target WM 적용 함수 - element 매칭 구간
# note: 해당 함수의 target materials index 검색
contains_15 = String.Contains(str=filterByBoolMask_17.in@L1, searchFor=code_block_75)
anyTrue_7 = List.AnyTrue(list=contains_15@L2)
code_block_78 = CodeBlock { true; }
# note: getting index of element which has target materials
allIndicesOf_9 = List.AllIndicesOf(list=anyTrue_7@L2, item=code_block_78)
flatten_20 = List.Flatten(list=allIndicesOf_9)
# note: wm 별 타겟 element 추출
getItemAtIndex_24 = List.GetItemAtIndex(list=filterByBoolMask_16.in, index=flatten_20)
watch_39 = Watch(getItemAtIndex_24)
watch_material_index_11 = Watch(filterByBoolMask_17.in)
map_3 = List.Map()  # unwired: list, function
count_9 = List.Count(list=flatten_20)
# note: 필요한 개수로 함수 리스트 증식
ofRepeatedItem_3 = List.OfRepeatedItem(item=function_compose_2, amount=count_9)
watch_40 = Watch(ofRepeatedItem_3)
# note: 엘리먼트와 함수 1대1 매칭 적용
laceShortest_3 = List.LaceShortest(combineFunction=map_3, list0=watch_40, list1=watch_39)
count_10 = List.Count(list=laceShortest_3)

# group: FamilyName, WorkMasterCode, Quantities, Unit 결합구간
name_16 = Element.Name(element=watch_39)
watch_material_index_12 = Watch(watch_material_index_11)
getItemAtIndex_25 = List.GetItemAtIndex(list=watch_material_index_12, index=flatten_20)
flatten_21 = List.Flatten(list=laceShortest_3)
watch_41 = Watch(flatten_21)
code_block_79 = CodeBlock { "TON"; }
code_block_80 = CodeBlock(familyName=name_16, workmasterCode=getItemAtIndex_25, quantities=watch_41, unit=code_block_79) { familyName +"..."+ workmasterCode +"..."+ quantities +"..."+ unit; }

# group: DATA 전처리
join = List.Join(list0=code_block_28, list1=code_block_40, list2=code_block_52, list3=code_block_65, list4=code_block_72, list5=code_block_80)
code_block_81 = CodeBlock { "..."; }
split_4 = String.Split(str=join, separator0=code_block_81)
watch_42 = Watch(split_4)

# group: Export Excel(By OpenpyXl)
python_script_export_excel_by = Python(IN[0]=watch_42)  # "Python Script@Export Excel(By OpenpyXl)"; CPython3; frozen
# ---------- python_script_export_excel_by.python (151 lines) ----------
# Load the Python Standard and DesignScript Libraries
import sys
import os
#sys.path.append(r'C:\Users\HEC\AppData\Local\Programs\Python\Python39\Lib\site-packages')
#sys.path.append(r'C:\Users\pjmk0\AppData\Local\Programs\Python\Python39\Lib\site-packages')
sys.path.append(os.getenv('LOCALAPPDATA').replace('\\','\\\\') + r'\Programs\Python\Python39\Lib\site-packages')
import clr
clr.AddReference('ProtoGeometry')
from Autodesk.DesignScript.Geometry import *
from collections import Iterable

def iterable(obj):
    return isinstance(obj, Iterable)


# The inputs to this node will be stored as a list in the IN variables.
dataEnteringNode = IN
ListIn = IN[0]

# Place your code below this line
import datetime
from datetime import date, timedelta
Today = date.today()
import openpyxl
from openpyxl.styles import Border, Side, PatternFill, Font, GradientFill, Alignment, Color, numbers

sample_items = ListIn


def write_to_file(filepath):
    wb = openpyxl.Workbook()
    for sheet in wb.sheetnames:
        wb.remove(wb[sheet])

    thin = Side(border_style="thin", color="000000")
    double = Side(border_style="double", color="000000")

    ws = wb.create_sheet(title='Wall_Calc_instance', index=0)

    ws.merge_cells('A1:L1')
    ws['A1'] = 'HEC Wall Category Calculation Sheet'
    cell = ws['A1']
    cell.font = openpyxl.styles.Font(color='000000', size=20)
    cell.fill = openpyxl.styles.fills.PatternFill(patternType='solid',
                                                  fgColor=openpyxl.styles.colors.Color(rgb='fff3b0'))

    ws['A2'] = 'Item Number'
    ws['A2'].font = openpyxl.styles.Font(b=True, color='000000', size=12)
    #ws['B2'] = 'Member Name'
    #ws['B2'].font = openpyxl.styles.Font(b=True, color='000000', size=12)
    #ws['C2'] = 'Category'
    #ws['C2'].font = openpyxl.styles.Font(b=True, color='000000', size=12)
    ws['B2'] = 'Family Type'
    ws['B2'].font = openpyxl.styles.Font(b=True, color='000000', size=12)
    ws['C2'] = 'WorkMaster Code'
    ws['C2'].font = openpyxl.styles.Font(b=True, color='000000', size=12)
    #ws['F2'] = 'WorkMaster Description'
    #ws['F2'].font = openpyxl.styles.Font(b=True, color='000000', size=12)
    #ws['G2'] = 'Unit'
    #ws['G2'].font = openpyxl.styles.Font(b=True, color='000000', size=12)
    #ws['H2'] = '계수'
    #ws['H2'].font = openpyxl.styles.Font(b=True, color='000000', size=12)
    #ws['I2'] = '계산 참조값'
    #ws['I2'].font = openpyxl.styles.Font(b=True, color='000000', size=12)
    ws['D2'] = 'Quantities'
    ws['D2'].font = openpyxl.styles.Font(b=True, color='000000', size=12)
    ws['E2'] = 'Unit'
    ws['E2'].font = openpyxl.styles.Font(b=True, color='000000', size=12)
    ws['F2'] = 'Unit Price'
    ws['F2'].font = openpyxl.styles.Font(b=True, color='000000', size=12)
    ws['G2'] = 'Total Price'
    ws['G2'].font = openpyxl.styles.Font(b=True, color='000000', size=12)


## 칼럼별 너비 조정 구간
#    for col in range(ws.max_column):
#        ws.column_dimensions[chr(ord('A') + col)].width = 15
    ws.column_dimensions['A'].width = 15
    ws.column_dimensions['B'].width = 45
    ws.column_dimensions['C'].width = 60
    ws.column_dimensions['D'].width = 20
    ws.column_dimensions['E'].width = 20
    ws.column_dimensions['F'].width = 20
    ws.column_dimensions['G'].width = 20
    #ws.column_dimensions['G'].width = 9
    #ws.column_dimensions['H'].width = 9
    #ws.column_dimensions['H'].hidden = True
    #ws.column_dimensions['I'].width = 12
    #ws.column_dimensions['I'].hidden = True
    #ws.column_dimensions['J'].width = 12
    #ws.column_dimensions['K'].width = 12
    #ws.column_dimensions['L'].width = 12

###
    start_row = 3
    for (row, item) in enumerate(sample_items, start_row):
        cell = ws.cell(row=row, column=1, value=row - 2)
        cell.alignment = openpyxl.styles.Alignment(horizontal='center', vertical='center')

#        cell = ws.cell(row=row, column=2, value=item[0])
#        cell.number_format = openpyxl.styles.numbers.FORMAT_DATE_YYYYMMDD2  # 'yyyy-mm-dd'
        ws.cell(row=row, column=2, value=item[0]) ## Family Type 칼럼

        ws.cell(row=row, column=3, value=item[1]) ## WorkMaster Code 칼럼
        
        ws.cell(row=row, column=4, value=item[2]) ## Quantities 칼럼
        
        ws.cell(row=row, column=5, value=item[3]) ## Unit 칼럼
        
        #cell = ws.cell(row=row, column=8, value=item[6]) ## 계수 칼럼
        #cell.number_format = openpyxl.styles.numbers.builtin_format_code(3)  # '#,##0'
        
        #cell = ws.cell(row=row, column=9, value=item[7]) ## 계산 참조값 칼럼
        #cell.number_format = openpyxl.styles.numbers.builtin_format_code(3)  # '#,##0'
        
        #cell = ws.cell(row=row, column=10, value=item[8]) ## Quantities 칼럼
        #cell.number_format = openpyxl.styles.numbers.builtin_format_code(3)  # '#,##0'
        #cell.font = openpyxl.styles.Font(b=True, color='000000', size=11)

        cell = ws.cell(row=row, column=7, value='= D{current_row}*F{current_row}'.format(current_row=cell.row))
        cell.number_format = '#,##0'

#        cell = ws.cell(row=row, column=6, value='= D{current_row} * E{current_row}'.format(current_row=cell.row))
#        cell.number_format = openpyxl.styles.numbers.builtin_format_code(3)

    total_row = ws.max_row + 1
    if total_row > start_row:
        cell1 = ws.cell(row=total_row, column=6, value='Total')
        cell1.font = openpyxl.styles.Font(b=True, color='000000', size=15)
        
        cell2 = ws.cell(row=total_row, column=7, value='= SUM(G{}:G{})'.format(start_row, total_row - 1))
        cell2.number_format = openpyxl.styles.numbers.builtin_format_code(3)
        cell2.border = Border(top=double, left=double, right=double, bottom=double)
        cell2.font = openpyxl.styles.Font(b=True, color='ff03ce', size=15)
    

    wb.save(filepath)
    wb.close()


##if __name__ == '__main__':
#write_to_file('C:\\Users\\pjmk0\\AppData\\Roaming\\test.xlsx')

save_name = "HecWallCalcSheet_" + Today.strftime("%Y-%m-%d")+".xlsx"
path = os.getenv('APPDATA').replace('\\','\\\\')
filePath = path + '\\' + save_name

write_to_file(filePath)

# Assign your output to the OUT variable.
OUT = os.getenv('APPDATA')
# ----------------------------------------

code_block_82 = CodeBlock {  }

# group: material index_old
getMaterials_2 = Element.GetMaterials(element=all_elements_of_category)
flatten_22 = List.Flatten(list=getMaterials_2)
name_17 = Element.Name(element=flatten_22)

uniqueItems_3 = List.UniqueItems(list=name_17)

# group: Row Index Guide
code_block_83 = CodeBlock(i=watch) { i[3]; }
watch_43 = Watch(code_block_83)

# group: C. Category
code_block_84 = CodeBlock { "Category"; }
getParameterValueByName_3 = Element.GetParameterValueByName(element=watch_all_elements_of_category, parameterName=code_block_84)

name_18 = Element.Name(element=getMaterials_2@L2)
code_block_85 = CodeBlock {  }
count_11 = List.Count(list=watch_wm_중복제거@L2)

# group: See Virtual Modeling
code_block_86 = CodeBlock { 100; }
byARGB = Color.ByARGB(a=code_block_86, g=code_block_86)
byGeometryColor = Modifiers.GeometryColor.ByGeometryColor(geometry=byLoft, color=byARGB)

# group: See Virtual Modeling
code_block_87 = CodeBlock { 100; }
byARGB_2 = Color.ByARGB(a=code_block_87, r=code_block_87)
byGeometryColor_2 = Modifiers.GeometryColor.ByGeometryColor(geometry=byLoft_2, color=byARGB_2)

# group: See Virtual Modeling
code_block_88 = CodeBlock { 100; }
byARGB_3 = Color.ByARGB(a=code_block_88, b=code_block_88)
byGeometryColor_3 = Modifiers.GeometryColor.ByGeometryColor(geometry=byLoft_3, color=byARGB_3)

# group: See Virtual Modeling
code_block_89 = CodeBlock { 50; }
byARGB_4 = Color.ByARGB(a=code_block_89, r=code_block_89, b=code_block_89)
byGeometryColor_4 = Modifiers.GeometryColor.ByGeometryColor(geometry=watch_35, color=byARGB_4)
