# Dynamo graph LeanCreator_rA(220107).dyn (Dynamo 2.12.0.5650)

byUnion = Solid.ByUnion()  # unwired: solids
categories = Categories("OST_StructuralFoundation")
all_elements_of_category = ElementsOfCategory(Category=categories)
categories_2 = Categories("OST_EdgeSlab")
all_elements_of_category_2 = ElementsOfCategory(Category=categories_2)
join = List.Join(list0=all_elements_of_category, list1=all_elements_of_category_2)
findJoinedPair = Python(IN[0]=join)  # CPython3
# ---------- findJoinedPair.python (34 lines) ----------
# Load the Python Standard and DesignScript Libraries
import sys
import clr
clr.AddReference('ProtoGeometry')
from Autodesk.DesignScript.Geometry import *

# The inputs to this node will be stored as a list in the IN variables.
dataEnteringNode = IN
elements = IN[0]

# Place your code below this line
def findJoinedPair(elements):
    result = []
    Ididx = [i.Id for i in elements]
    _log = []
    for i in elements:
        tmp1= [i]
        if i.Id not in _log:
            _log.append(i.Id)
            joinlist = i.GetJoinedElements()
            if len(joinlist):
                for j in joinlist:
                    if j.Id in Ididx:
                        idx = Ididx.index(j.Id)
                        _log.append(idx)
                        tmp1.append(j)
                        
            result.append(tmp1)
        else:
            pass
    return result
    
# Assign your output to the OUT variable.
OUT = findJoinedPair(elements)
# ----------------------------------------
geometry = Element.Geometry(element=findJoinedPair)
flatten = List.Flatten(list=geometry@L3)
makeUnion = Python(IN[0]=flatten)  # CPython3
# ---------- makeUnion.python (26 lines) ----------
# Load the Python Standard and DesignScript Libraries
import sys
import clr
clr.AddReference('ProtoGeometry')
from Autodesk.DesignScript.Geometry import *

# The inputs to this node will be stored as a list in the IN variables.
dataEnteringNode = IN
inputpairs = IN[0]

# Place your code below this line
def makeUnion(pair):
    result = []
    if len(pair)>1:
        acc = pair[0]
        for i in range(0, len(pair)):
            tmp = acc.Union(pair[i])
            acc = tmp
        result.append(acc)
    else:
        acc = pair[0]
        result.append(acc)
    return result
        
# Assign your output to the OUT variable.
OUT = [makeUnion(i) for i in inputpairs]
# ----------------------------------------
explode = Geometry.Explode(geometry=makeUnion)
flatten_2 = List.Flatten(list=explode@L3)
integer_slider = IntegerSlider(6, range=0..17 step 1)
code_block = CodeBlock(i=flatten_2, j=integer_slider) { i[j]; }
code_block_2 = CodeBlock(i=findJoinedPair) { i[6]; }
geometry_2 = Element.Geometry(element=code_block_2)
code_block_3 = CodeBlock(i=geometry_2) { i[0]; i[1]; }
union = Solid.Union(solid=code_block_3.out0, solid_2=code_block_3.out1)
explode_2 = Geometry.Explode(geometry=union)
flatten_3 = List.Flatten(list=explode_2)
code_block_4 = CodeBlock { 0.5; }
normalAtParameter = Surface.NormalAtParameter(surface=flatten_2, u=code_block_4, v=code_block_4)
Z = Vector.Z(vector=normalAtParameter)
findBeneathSrf = Python(IN[0]=flatten_2)  # CPython3
# ---------- findBeneathSrf.python (33 lines) ----------
# Load the Python Standard and DesignScript Libraries
import sys
import clr
clr.AddReference('ProtoGeometry')
from Autodesk.DesignScript.Geometry import *

# The inputs to this node will be stored as a list in the IN variables.
dataEnteringNode = IN
srfGroups = IN[0]

# Place your code below this line
def findBeneathSrf(srfGroup):
    result = []
    upperSrfs = [i for i in srfGroup if i.NormalAtParameter(0.5,0.5).Z == 1]
    headCrvs = []
    for i in upperSrfs:
        headCrv = PolyCurve.ByJoinedCurves(i.PerimeterCurves())
        headCrvs.append(headCrv)
    
    for i in srfGroup:
        tmp=[]
        for j in headCrvs:
            if i.DoesIntersect(j):
                tmp.append(False)
            else:
                tmp.append(True)
        if all(tmp):
            result.append(i)
    
    return result

# Assign your output to the OUT variable.
OUT = [findBeneathSrf(i) for i in srfGroups]
# ----------------------------------------
byJoinedSurfaces = PolySurface.ByJoinedSurfaces(surfaces=findBeneathSrf)
code_block_5 = CodeBlock { 100; }
boolean = BoolSelector(false)
thicken = Surface.Thicken(thickness=code_block_5, both_sides=boolean)  # unwired: surface
code_block_6 = CodeBlock { 11; }
removeItemAtIndex = List.RemoveItemAtIndex(list=thicken, indices=code_block_6)
categories_3 = Categories("OST_GenericModel")
code_block_7 = CodeBlock { "LC111"; }
byGeometry = DirectShape.ByGeometry(geometry=removeItemAtIndex, category=categories_3, name=code_block_7)  # frozen
code_block_8 = CodeBlock(i=findBeneathSrf) { i[6]; }

# group: 중요!!!
findSrfForExtending = Python(IN[0]=code_block_8)  # CPython3
# ---------- findSrfForExtending.python (23 lines) ----------
# Load the Python Standard and DesignScript Libraries
import sys
import clr
clr.AddReference('ProtoGeometry')
from Autodesk.DesignScript.Geometry import *

# The inputs to this node will be stored as a list in the IN variables.
dataEnteringNode = IN
srfGroups = IN[0]
# Place your code below this line
def findSrfForExtending(srfGroups):
    bdBox = BoundingBox.ByGeometry(srfGroups)
    bdBoxsolid = bdBox.ToCuboid()
    btmSrf = [i for i in bdBoxsolid.Explode() if i.NormalAtParameter(0.5,0.5).Z==-1][0]
    btmCrv = PolyCurve.ByJoinedCurves(btmSrf.PerimeterCurves())
    srfForExtending = [i for i in srfGroups if i.DoesIntersect(btmCrv)]
    otherSrf = [i for i in srfGroups if not i.DoesIntersect(btmCrv)]
    
    return (srfForExtending, otherSrf)
    pass

# Assign your output to the OUT variable.
OUT = findSrfForExtending(srfGroups)
# ----------------------------------------

code_block_9 = CodeBlock(i=findSrfForExtending) { i[0]; }
code_block_10 = CodeBlock(i=code_block_9) { i[0]; }
perimeterCurves = Surface.PerimeterCurves(surface=code_block_10)
code_block_11 = CodeBlock { 200; }
offset = Curve.Offset(curve=perimeterCurves, distance=code_block_11)
code_block_12 = CodeBlock(i=offset) { i[1]; }
code_block_13 = CodeBlock(i=perimeterCurves, j=code_block_12) { [i[0], j,i[2],i[3]]; }
startPoint = Curve.StartPoint(curve=code_block_13)
endPoint = Curve.EndPoint(curve=code_block_13)
python_script = Python(IN[0]=startPoint, IN[1]=endPoint)  # CPython3
# ---------- python_script.python (13 lines) ----------
# Load the Python Standard and DesignScript Libraries
import sys
import clr
clr.AddReference('ProtoGeometry')
from Autodesk.DesignScript.Geometry import *

# The inputs to this node will be stored as a list in the IN variables.
dataEnteringNode = IN

# Place your code below this line
result = set(IN[0] + IN[1])
# Assign your output to the OUT variable.
OUT = result
# ----------------------------------------
code_block_14 = CodeBlock()
# ---------- code_block_14.designscript (3 lines) ----------
//서피스를 이루는 페리미터 커브 멤버들간의 결합 정보를 저장하고,
//멤버 중 일부의 위치가 변경되었을때
//연관된 다른 멤버가 결합 정보를 유지하기 위해 동시에 변하는 구조체를 만들자
# ----------------------------------------
