# Dynamo graph Str Framing Calculator_HEC(0708).dyn (Dynamo 2.10.1.3976)

# group: Str Framing
code_block = CodeBlock {  }
code_block_2 = CodeBlock {  }

# group: select all Category element
categories = Categories("OST_StructuralFraming")
all_elements_of_category = ElementsOfCategory(Category=categories)
code_block_3 = CodeBlock { "Reference Level"; }
parameterByName = Parameter.ParameterByName(element=all_elements_of_category, name=code_block_3)
string_from_object = FromObject(object=parameterByName)
uniqueItems = List.UniqueItems(list=string_from_object)
code_block_4 = CodeBlock(i=string_from_object, j=uniqueItems) { i == j[0]; }
filterByBoolMask = List.FilterByBoolMask(list=all_elements_of_category, mask=code_block_4)

# group: Concrete - Steel 부재 구분
watch = Watch(all_elements_of_category)
elementType = Element.ElementType(element=watch)
familyName = ElementType.FamilyName(elementType=elementType)
watch_2 = Watch(familyName)
string_from_object_2 = FromObject(object=watch_2)
code_block_5 = CodeBlock { "Concrete"; }
contains = String.Contains(str=string_from_object_2, searchFor=code_block_5)
filterByBoolMask_2 = List.FilterByBoolMask(list=all_elements_of_category, mask=contains)

# group: Steel
watch_3 = Watch(filterByBoolMask_2.out)
name = FamilyType.Name(familyType=watch_3)
string_from_object_3 = FromObject(object=name)
code_block_6 = CodeBlock { "BM"; }
contains_2 = String.Contains(str=string_from_object_3, searchFor=code_block_6)
filterByBoolMask_3 = List.FilterByBoolMask(list=watch_3, mask=contains_2)
watch_4 = Watch(filterByBoolMask_3.in)
# note: Built up
watch_5 = Watch(filterByBoolMask_3.out)

# group: Concrete
watch_6 = Watch(filterByBoolMask_2.in)

# group: surface
watch_7 = Watch(watch_4)
geometry = Element.Geometry(element=watch_7)
watch_8 = Watch(geometry)
watch_9 = Watch(watch_6)
geometry_2 = Element.Geometry(element=watch_9)
watch_10 = Watch(geometry_2)
faces = Element.Faces(element=watch_9)
faces_2 = Element.Faces(element=watch_7)

# group: Surface Area (Concrete)
flatten = List.Flatten(list=faces)
area = Surface.Area(surface=flatten)

# group: Surface Area (Steel)
flatten_2 = List.Flatten(list=faces_2)
area_2 = Surface.Area(surface=flatten_2)

code_block_7 = CodeBlock { UW; }  # unwired: UW
code_block_8 = CodeBlock { 90; 30; }
# note: Built up 제외외
ge = code_block_7 >= code_block_8.out0
lt = code_block_7 < code_block_8.out1
ge_2 = code_block_7 >= code_block_8.out1
# note: Built up 자제만
watch_11 = Watch(ge_2)
le = watch_11 <= code_block_8.out0
watch_12 = Watch(watch_7)

# group: Mass per Unit Length (kg/m) 추출
elementType_2 = Element.ElementType(element=watch_12)
list_create = List.Create(item0=elementType_2)
code_block_9 = CodeBlock { "Mass per Unit Length"; }
getParameterValueByName = Element.GetParameterValueByName(element=elementType_2, parameterName=code_block_9)

# group: Type Parameter 추출 Check
parameters = Element.Parameters(element=list_create)
name_2 = Parameter.Name(parameter=parameters)
code_block_10 = CodeBlock { "Mass per Unit Length"; }
contains_3 = String.Contains(str=name_2, searchFor=code_block_10)
countTrue = List.CountTrue(list=contains_3)

# group: Length(mm) 추출
code_block_11 = CodeBlock { "Length"; }
getParameterValueByName_2 = Element.GetParameterValueByName(element=watch_12, parameterName=code_block_11)

# group: Unit Weight x Length (Ton)
# note: 단위변환 kg -> ton
code_block_12 = CodeBlock(i=getParameterValueByName) { i[]*0.001; }
# note: 단위변환 mm -> m
code_block_13 = CodeBlock(i=getParameterValueByName_2) { i[]*0.001; }
mul = code_block_12 * code_block_13

# group: Excel Import
file_path = Filename("..\BIM_물량집계 자동화 산출기준표_rC(20210708)_KCS.xlsx")
file_from_path = FileObject(path=file_path)
code_block_14 = CodeBlock { "Scope_lv2(Str Framing)"; }
code_block_15 = CodeBlock { false; }
importExcel = Data.ImportExcel(file=file_from_path, sheetName=code_block_14, showExcel=code_block_15)

# group: Null값 처리
code_block_16 = CodeBlock { " "; }
isNull = Object.IsNull()  # unwired: object
replaceByCondition = Replace(item=importExcel, replaceWith=code_block_16, condition=isNull)

# group: Whole Data(row direction)
watch_13 = Watch(replaceByCondition)

identity = Object.Identity(object=watch_13)
identity_2 = Object.Identity(object=identity)
code_block_17 = CodeBlock(i=identity_2) { i[3]; }
watch_14 = Watch(code_block_17)

# group: Whole Data(Column direction)
transpose = List.Transpose(lists=replaceByCondition)
watch_15 = Watch(transpose)

# group: Column Index Guide
code_block_18 = CodeBlock(i=watch_13) { i[3]; }
watch_16 = Watch(code_block_18)

# group: 모델링에 사용된 모든 패밀리타입 코드 추출
elementType_3 = Element.ElementType(element=all_elements_of_category)
name_3 = Element.Name(element=elementType_3)
uniqueItems_2 = List.UniqueItems(list=name_3@L2)
flatten_3 = List.Flatten(list=uniqueItems_2)
watch_17 = Watch(flatten_3)
code_block_19 = CodeBlock { "_"; }
split = String.Split(str=watch_17, separator0=code_block_19)
firstItem = List.FirstItem(list=split@L2)

# group: 사용된 패밀리타입이 위치한 Column Index 추출
string_from_object_4 = FromObject(object=watch_16)
contains_4 = String.Contains(searchFor=firstItem, lacing=CrossProduct)  # unwired: str
map = List.Map(list=string_from_object_4, function=contains_4)
allFalse = List.AllFalse(list=map@L2)
code_block_20 = CodeBlock(i=allFalse) { i==false?true:false; }
code_block_21 = CodeBlock { true; }
allIndicesOf = List.AllIndicesOf(list=code_block_20, item=code_block_21)

# group: 사용된 패밀리타입 Column Data 추출
identity_3 = Object.Identity(object=allIndicesOf@L1)
getItemAtIndex = List.GetItemAtIndex(list=watch_15, index=identity_3)
code_block_22 = CodeBlock { 4; ""; }
# note: 불필요 정보 처리
replaceItemAtIndex = List.ReplaceItemAtIndex(list=getItemAtIndex@L2, index=code_block_22.out0, item=code_block_22.out1)
watch_18 = Watch(getItemAtIndex)

# group: 사용된 패밀리 타입에서 세부코드가 기입된 Row 열 번호 추출
string_from_object_5 = FromObject(object=replaceItemAtIndex)
code_block_23 = CodeBlock { "000"; }
contains_5 = String.Contains(str=string_from_object_5@L2, searchFor=code_block_23, lacing=CrossProduct)
code_block_24 = CodeBlock { true; }
allIndicesOf_2 = List.AllIndicesOf(list=contains_5@L2, item=code_block_24)
watch_19 = Watch(allIndicesOf_2)

getItemAtIndex_2 = List.GetItemAtIndex(list=identity_2, index=watch_19@L2)
watch_20 = Watch(getItemAtIndex_2)
code_block_25 = CodeBlock { 2; }
getItemAtIndex_3 = List.GetItemAtIndex(list=watch_20@@L2, index=code_block_25)
watch_21 = Watch(getItemAtIndex_3)
code_block_26 = CodeBlock { "Area"; }
getParameterValueByName_3 = Element.GetParameterValueByName(parameterName=code_block_26)  # unwired: element

# group: 함수목록 테스트
python_script_export_excel_by = Python()  # "Python Script@Export Excel(By OpenpyXl)"; CPython3; frozen; unwired: IN[0]
# ---------- python_script_export_excel_by.python (145 lines) ----------
# Load the Python Standard and DesignScript Libraries
import sys
import os
#sys.path.append(r'C:\Users\HEC\AppData\Local\Programs\Python\Python39\Lib\site-packages')
#sys.path.append(r'C:\Users\pjmk0\AppData\Local\Programs\Python\Python39\Lib\site-packages')
sys.path.append(os.getenv('LOCALAPPDATA').replace('\\','\\\\') + r'\Programs\Python\Python39\Lib\site-packages')
import clr
clr.AddReference('ProtoGeometry')
from Autodesk.DesignScript.Geometry import *
from collections import Iterable

def iterable(obj):
    return isinstance(obj, Iterable)


# The inputs to this node will be stored as a list in the IN variables.
dataEnteringNode = IN
ListIn = IN[0]

# Place your code below this line
import datetime
import openpyxl
from openpyxl.styles import Border, Side, PatternFill, Font, GradientFill, Alignment

sample_items = ListIn


def write_to_file(filepath):
    wb = openpyxl.Workbook()
    for sheet in wb.sheetnames:
        wb.remove(wb[sheet])

    thin = Side(border_style="thin", color="000000")
    double = Side(border_style="double", color="000000")

    ws = wb.create_sheet(title='Wall_Calc_instance', index=0)

    ws.merge_cells('A1:L1')
    ws['A1'] = 'HEC Bidding Calculation Sheet'
    cell = ws['A1']
    cell.font = openpyxl.styles.Font(color='000000', size=20)
    cell.fill = openpyxl.styles.fills.PatternFill(patternType='solid',
                                                  fgColor=openpyxl.styles.colors.Color(rgb='fff3b0'))

    ws['A2'] = 'Item Number'
    ws['A2'].font = openpyxl.styles.Font(b=True, color='000000', size=12)
    ws['B2'] = 'Member Name'
    ws['B2'].font = openpyxl.styles.Font(b=True, color='000000', size=12)
    ws['C2'] = 'Category'
    ws['C2'].font = openpyxl.styles.Font(b=True, color='000000', size=12)
    ws['D2'] = 'Family Type'
    ws['D2'].font = openpyxl.styles.Font(b=True, color='000000', size=12)
    ws['E2'] = 'WorkMaster Code'
    ws['E2'].font = openpyxl.styles.Font(b=True, color='000000', size=12)
    ws['F2'] = 'WorkMaster Description'
    ws['F2'].font = openpyxl.styles.Font(b=True, color='000000', size=12)
    ws['G2'] = 'Unit'
    ws['G2'].font = openpyxl.styles.Font(b=True, color='000000', size=12)
    ws['H2'] = '계수'
    ws['H2'].font = openpyxl.styles.Font(b=True, color='000000', size=12)
    ws['I2'] = '계산 참조값'
    ws['I2'].font = openpyxl.styles.Font(b=True, color='000000', size=12)
    ws['J2'] = 'Quantities'
    ws['J2'].font = openpyxl.styles.Font(b=True, color='000000', size=12)
    ws['K2'] = 'Unit Price'
    ws['K2'].font = openpyxl.styles.Font(b=True, color='000000', size=12)
    ws['L2'] = 'Total Price'
    ws['L2'].font = openpyxl.styles.Font(b=True, color='000000', size=12)


## 칼럼별 너비 조정 구간
#    for col in range(ws.max_column):
#        ws.column_dimensions[chr(ord('A') + col)].width = 15
    ws.column_dimensions['A'].width = 15
    ws.column_dimensions['B'].width = 25
    ws.column_dimensions['C'].width = 12
    ws.column_dimensions['D'].width = 20
    ws.column_dimensions['E'].width = 20
    ws.column_dimensions['F'].width = 52
    ws.column_dimensions['G'].width = 9
    #ws.column_dimensions['H'].width = 9
    ws.column_dimensions['H'].hidden = True
    #ws.column_dimensions['I'].width = 12
    ws.column_dimensions['I'].hidden = True
    ws.column_dimensions['J'].width = 12
    ws.column_dimensions['K'].width = 12
    ws.column_dimensions['L'].width = 12

###
    start_row = 3
    for (row, item) in enumerate(sample_items, start_row):
        cell = ws.cell(row=row, column=1, value=row - 2)
        cell.alignment = openpyxl.styles.Alignment(horizontal='center', vertical='center')

#        cell = ws.cell(row=row, column=2, value=item[0])
#        cell.number_format = openpyxl.styles.numbers.FORMAT_DATE_YYYYMMDD2  # 'yyyy-mm-dd'
        ws.cell(row=row, column=2, value=item[0]) ## Room Name 칼럼

        ws.cell(row=row, column=3, value=item[1]) ## Department 칼럼
        
        ws.cell(row=row, column=4, value=item[2]) ## Interior Finish Type 칼럼
        
        ws.cell(row=row, column=5, value=item[3]) ## WorkMaster Code 칼럼
        
        ws.cell(row=row, column=6, value=item[4]) ## WorkMaster Description 칼럼
        
        ws.cell(row=row, column=7, value=item[5]) ## Unit 칼럼

        cell = ws.cell(row=row, column=8, value=item[6]) ## 계수 칼럼
        cell.number_format = openpyxl.styles.numbers.builtin_format_code(3)  # '#,##0'
        
        cell = ws.cell(row=row, column=9, value=item[7]) ## 계산 참조값 칼럼
        cell.number_format = openpyxl.styles.numbers.builtin_format_code(3)  # '#,##0'
        
        cell = ws.cell(row=row, column=10, value=item[8]) ## Quantities 칼럼
        cell.number_format = openpyxl.styles.numbers.builtin_format_code(3)  # '#,##0'
        cell.font = openpyxl.styles.Font(b=True, color='000000', size=11)

        cell = ws.cell(row=row, column=12, value='= J{current_row}*K{current_row}'.format(current_row=cell.row))
        cell.number_format = '#,##0'

#        cell = ws.cell(row=row, column=6, value='= D{current_row} * E{current_row}'.format(current_row=cell.row))
#        cell.number_format = openpyxl.styles.numbers.builtin_format_code(3)

    total_row = ws.max_row + 1
    if total_row > start_row:
        cell1 = ws.cell(row=total_row, column=11, value='Total')
        cell1.font = openpyxl.styles.Font(b=True, color='000000', size=15)
        
        cell2 = ws.cell(row=total_row, column=12, value='= SUM(L{}:L{})'.format(start_row, total_row - 1))
        cell2.number_format = openpyxl.styles.numbers.builtin_format_code(3)
        cell2.border = Border(top=double, left=double, right=double, bottom=double)
        cell2.font = openpyxl.styles.Font(b=True, color='ff03ce', size=15)
    

    wb.save(filepath)
    wb.close()


##if __name__ == '__main__':
#write_to_file('C:\\Users\\pjmk0\\AppData\\Roaming\\test.xlsx')
write_to_file(os.getenv('APPDATA').replace('\\','\\\\') + r'\HecBiddingCalcSheet1.xlsx')

# Assign your output to the OUT variable.
OUT = os.getenv('APPDATA')
# ----------------------------------------
code_block_27 = CodeBlock { 0..10; }
code_block_28 = CodeBlock()
# ---------- code_block_28.designscript (5 lines) ----------
[
"0",
"1",
"2"
];
# ----------------------------------------
code_block_29 = CodeBlock(a=getParameterValueByName_3, b=getParameterValueByName_3, c=getParameterValueByName_3) { [a,b,c]; }
map_2 = List.Map(list=code_block_28, function=code_block_29)
code_block_30 = CodeBlock { "-"; }
split_2 = String.Split(separator0=code_block_30)  # unwired: str
byKeysValues = DesignScript.Builtin.Dictionary.ByKeysValues(keys=code_block_28, values=code_block_29)
valueAtKey = DesignScript.Builtin.Dictionary.ValueAtKey(dictionary=byKeysValues, key=code_block_28)
map_3 = List.Map(list=code_block_28, function=valueAtKey)
code_block_31 = CodeBlock { 0; }
code_block_32 = CodeBlock { 5; }
remove = String.Remove(startIndex=code_block_31, count=code_block_32)  # unwired: string

laceShortest = List.LaceShortest(combineFunction=valueAtKey)  # unwired: list0, list1
laceShortest_2 = List.LaceShortest(combineFunction=laceShortest, list1=valueAtKey)  # unwired: list0

# group: Select category element
watch_22 = Watch(all_elements_of_category)

# group: C. Category
code_block_33 = CodeBlock { "Category"; }
getParameterValueByName_4 = Element.GetParameterValueByName(element=watch_22, parameterName=code_block_33)

watch_23 = Watch(watch_22)

# group: D. Family Type
elementType_4 = Element.ElementType(element=watch_22)
name_4 = Element.Name(element=elementType_4)

watch_24 = Watch(name_4)
map_4 = List.Map(function=laceShortest)  # unwired: list
code_block_34 = CodeBlock { t1 = [1, 2, 3]; t2 = List.Flatten(t1, -1); }

# group: Row Index Guide
code_block_35 = CodeBlock(i=watch_15) { i[3]; }
watch_25 = Watch(code_block_35)

# group: material inform from modeling <per element>
getMaterials = Element.GetMaterials(element=watch_22)
name_5 = Element.Name(element=getMaterials)
code_block_36 = CodeBlock { "_"; }
split_3 = String.Split(str=name_5, separator0=code_block_36)
firstItem_2 = List.FirstItem(list=split_3@L2)
count = List.Count(list=getMaterials@L2)
chop = List.Chop(list=firstItem_2, lengths=count)

watch_26 = Watch(replaceItemAtIndex)
code_block_37 = CodeBlock { 0; }
getItemAtIndex_4 = List.GetItemAtIndex(list=watch_20@@L2, index=code_block_37)
watch_27 = Watch(getItemAtIndex_4)
getItemAtIndex_5 = List.GetItemAtIndex(list=watch_26@L2, index=watch_19@L2)
watch_28 = Watch(getItemAtIndex_5)
code_block_38 = CodeBlock(i=watch_27, j=watch_28) { i + "-" + j; }

# group: Wall Type: WM Code 딕셔너리 생성(벽체 layer에 포함 되지 않은 WM code 까지 포함되어야함)
code_block_39 = CodeBlock { 3; }
getItemAtIndex_6 = List.GetItemAtIndex(list=watch_26@L2, index=code_block_39)
code_block_40 = CodeBlock { "_"; "-"; }
split_4 = String.Split(str=getItemAtIndex_6, separator0=code_block_40.out0, separator1=code_block_40.out1)
firstItem_3 = List.FirstItem(list=split_4@L2)
byKeysValues_2 = DesignScript.Builtin.Dictionary.ByKeysValues(keys=firstItem_3, values=code_block_38)
watch_29 = Watch(byKeysValues_2)

# group: material inform from excel sheet <per family type>
watch_30 = Watch(watch_29)

# group: material inform from excel sheet <per element>
keys = DesignScript.Builtin.Dictionary.Keys(dictionary=watch_30)
name_6 = Element.Name(element=elementType_4)
contains_6 = String.Contains(str=name_6, searchFor=keys, lacing=CrossProduct)
code_block_41 = CodeBlock { true; }
allIndicesOf_3 = List.AllIndicesOf(list=contains_6@L2, item=code_block_41)
flatten_4 = List.Flatten(list=allIndicesOf_3)
getItemAtIndex_7 = List.GetItemAtIndex(list=keys, index=flatten_4)
valueAtKey_2 = DesignScript.Builtin.Dictionary.ValueAtKey(dictionary=watch_30, key=getItemAtIndex_7)

# group: 합집합
add = _ + _  # unwired: x, y
code_block_42 = CodeBlock { "..."; }
add_2 = chop@L2 + code_block_42
combine = List.Combine(combineFunction=add, list0=add_2, list1=valueAtKey_2)
isNull_2 = Object.IsNull(object=combine)
anyTrue = List.AnyTrue(list=isNull_2@L2)
code_block_43 = CodeBlock { true; }
allIndicesOf_4 = List.AllIndicesOf(list=anyTrue, item=code_block_43)
removeItemAtIndex = List.RemoveItemAtIndex(list=combine, indices=allIndicesOf_4)
code_block_44 = CodeBlock { "..."; }
split_5 = String.Split(str=removeItemAtIndex, separator0=code_block_44)
code_block_45 = CodeBlock { 1; }
flatten_5 = List.Flatten(list=split_5@L3, amt=code_block_45)

# group: 중복제거
uniqueItems_3 = List.UniqueItems(list=flatten_5@L2)

# group: 인덱스-엘리먼트, 인덱스-WM code 딕셔너리 형성
count_2 = List.Count(list=watch_23)
code_block_46 = CodeBlock(j=count_2) { 0..(j-1); }
string_from_object_6 = FromObject(object=code_block_46)
byKeysValues_3 = DesignScript.Builtin.Dictionary.ByKeysValues(keys=string_from_object_6, values=uniqueItems_3)
watch_31 = Watch(byKeysValues_3)
byKeysValues_4 = DesignScript.Builtin.Dictionary.ByKeysValues(keys=string_from_object_6, values=watch_23)
watch_32 = Watch(byKeysValues_4)

byKeysValues_5 = DesignScript.Builtin.Dictionary.ByKeysValues(keys=string_from_object_6, values=watch_24)
watch_33 = Watch(byKeysValues_5)
valueAtKey_3 = DesignScript.Builtin.Dictionary.ValueAtKey(dictionary=watch_33, key=string_from_object_6)
valueAtKey_4 = DesignScript.Builtin.Dictionary.ValueAtKey(dictionary=watch_31, key=string_from_object_6)
code_block_47 = CodeBlock { "0"; }

# group: Family Type 별 sorting
elementType_5 = Element.ElementType()  # unwired: element
uniqueItems_4 = List.UniqueItems(list=elementType_5)
groupByFunction = List.GroupByFunction(list=all_elements_of_category@L2, groupFunction=uniqueItems_4)

parameters_2 = Element.Parameters(element=watch_12)
code_block_48 = CodeBlock {  }
code_block_49 = CodeBlock {  }
