# Dynamo graph Str Foundation Calculator_HEC(0625).dyn "Str Foundation Calculator(0625)" (Dynamo 2.10.1.3976)

# group: select all Category element
categories = Categories("OST_StructuralFoundation")
all_elements_of_category = ElementsOfCategory(Category=categories)
code_block = CodeBlock { "Level"; }
parameterByName = Parameter.ParameterByName(element=all_elements_of_category, name=code_block)
string_from_object = FromObject(object=parameterByName)
uniqueItems = List.UniqueItems(list=string_from_object)
code_block_2 = CodeBlock(i=string_from_object, j=uniqueItems) { i == j[0]; }
filterByBoolMask = List.FilterByBoolMask(list=all_elements_of_category, mask=code_block_2)

watch = Watch(filterByBoolMask.in)
watch_2 = Watch(filterByBoolMask.out)
watch_3 = Watch(all_elements_of_category)
name = FamilyType.Name(familyType=watch_3)
string_from_object_2 = FromObject(object=name)
code_block_3 = CodeBlock { "FT112"; }
contains = String.Contains(str=string_from_object_2, searchFor=code_block_3)
filterByBoolMask_2 = List.FilterByBoolMask(list=watch_3, mask=contains)
watch_4 = Watch(filterByBoolMask_2.in)

# group: All faces
faces = Element.Faces(element=watch_4)

# group: 하부, 측부 Surface 추출 경사에 따라 Vector 값 범위 확정 필요 [ ] > 확정 후 하부, 측부 분리 > 분리 후 edge 추출 진행 > 분리 후 면적 총합 산출 진행
flatten = List.Flatten(list=faces)
code_block_4 = CodeBlock { 0.5; }
normalAtParameter = Surface.NormalAtParameter(surface=flatten, u=code_block_4, v=code_block_4)
Z = Vector.Z(vector=normalAtParameter@L2)
code_block_5 = CodeBlock(a=Z) { a<0; }
filterByBoolMask_3 = List.FilterByBoolMask(list=flatten, mask=code_block_5@L2)
# note: Surface 겹침 확인 필요 격자형
# 침
watch_5 = Watch(filterByBoolMask_3.in)
flatten_2 = List.Flatten(list=watch_5)
code_block_6 = CodeBlock(a=Z) { a==0; }
filterByBoolMask_4 = List.FilterByBoolMask(list=flatten, mask=code_block_6@L2)
watch_6 = Watch(filterByBoolMask_4.in)
flatten_3 = List.Flatten(list=watch_6)
code_block_7 = CodeBlock(i=Z) { i == 1 ||i == -1? false:true; }
isAlmostEqualTo = Vector.IsAlmostEqualTo()  # unwired: vector, other

# group: edge 검토 후 진행
perimeterCurves = Surface.PerimeterCurves(surface=flatten_2)
perimeterCurves_2 = Surface.PerimeterCurves(surface=flatten_3)

code_block_8 = CodeBlock { 2; }
round = Math.Round(number=Z, digits=code_block_8)
code_block_9 = CodeBlock(a=round) { a==0; a>0; a<0; a==-1; }
filterByBoolMask_5 = List.FilterByBoolMask(list=flatten, mask=code_block_9.out3@L2)
watch_7 = Watch(filterByBoolMask_5.in)
flatten_4 = List.Flatten(list=watch_7)
byGeometry = BoundingBox.ByGeometry(geom=flatten_4)
toCuboid = BoundingBox.ToCuboid(boundingBox=byGeometry)
explode = Geometry.Explode(geometry=toCuboid)
perimeterCurves_3 = Surface.PerimeterCurves(surface=explode)
startPoint = Curve.StartPoint(curve=perimeterCurves_3)

# group: 독립 기초용 따로 만들어야함
boolean = BoolSelector(true)
byPoints = PolyCurve.ByPoints(points=startPoint, connectLastToFirst=boolean)
code_block_10 = CodeBlock { 100; }
offset = Curve.Offset(curve=byPoints, distance=code_block_10)
code_block_11 = CodeBlock { 700; }
offset_2 = Curve.Offset(curve=byPoints, distance=code_block_11)
ZAxis = Vector.ZAxis()
code_block_12 = CodeBlock { 1000; }
translate = Geometry.Translate(geometry=offset_2, direction=ZAxis, distance=code_block_12)
join = List.Join(list0=offset, list1=translate)
byLoft = Solid.ByLoft(crossSections=join)
code_block_13 = CodeBlock { 100; }
byARGB = Color.ByARGB(a=code_block_13, r=code_block_13)
byGeometryColor = Modifiers.GeometryColor.ByGeometryColor(geometry=byLoft, color=byARGB)

watch_8 = Watch(byLoft)
volume = Solid.Volume(solid=watch_8)
categories_2 = Categories("OST_StructuralFraming")
all_elements_of_category_2 = ElementsOfCategory(Category=categories_2)
geometry = Element.Geometry(element=all_elements_of_category_2)
categories_3 = Categories("OST_StructuralColumns")
all_elements_of_category_3 = ElementsOfCategory(Category=categories_3)
geometry_2 = Element.Geometry(element=all_elements_of_category_3)
geometry_3 = Element.Geometry(element=all_elements_of_category)
list_create = List.Create(item0=geometry, item1=geometry_2, item2=geometry_3)
flatten_5 = List.Flatten(list=list_create)
byUnion = Solid.ByUnion(solids=flatten_5)
intersect = Geometry.Intersect(geometry=watch_8, other=byUnion)
volume_2 = Solid.Volume(solid=intersect)
sub = volume - volume_2
watch_9 = Watch(sub)

# group: Str Framing
code_block_14 = CodeBlock {  }
code_block_15 = CodeBlock {  }

perimeterCurves_4 = Surface.PerimeterCurves(surface=flatten_4)
startPoint_2 = Curve.StartPoint(curve=perimeterCurves_4)
boolean_2 = BoolSelector(true)
byPoints_2 = PolyCurve.ByPoints(points=startPoint_2, connectLastToFirst=boolean_2)
code_block_16 = CodeBlock { 100; }
offset_3 = Curve.Offset(curve=byPoints_2, distance=code_block_16)
code_block_17 = CodeBlock { 0.5; }
normalAtParameter_2 = Surface.NormalAtParameter(surface=flatten_4, u=code_block_17, v=code_block_17)
Z_2 = Vector.Z(vector=normalAtParameter_2)
watch_10 = Watch(Z_2)
code_block_18 = CodeBlock(z=watch_10) { z>0; }
reverse = Vector.Reverse(vector=normalAtParameter_2)
if_ = If(test=code_block_18, true=reverse, false=normalAtParameter_2)
code_block_19 = CodeBlock { 400; }
extrudeAsSolid = Curve.ExtrudeAsSolid(curve=offset_3, direction=if_, distance=code_block_19)
explode_2 = Geometry.Explode(geometry=extrudeAsSolid)
flatten_6 = List.Flatten(list=explode_2)
code_block_20 = CodeBlock { 0.5; }
normalAtParameter_3 = Surface.NormalAtParameter(surface=flatten_6, u=code_block_20, v=code_block_20)
Z_3 = Vector.Z(vector=normalAtParameter_3@L2)
code_block_21 = CodeBlock { 2; }
round_2 = Math.Round(number=Z_3, digits=code_block_21)
code_block_22 = CodeBlock(a=round_2) { a==0; a>0; a<0; }
filterByBoolMask_6 = List.FilterByBoolMask(list=flatten_6, mask=code_block_22.out2@L2)
flatten_7 = List.Flatten(list=filterByBoolMask_6.in)
perimeterCurves_5 = Surface.PerimeterCurves(surface=flatten_7)
startPoint_3 = Curve.StartPoint(curve=perimeterCurves_5)
boolean_3 = BoolSelector(true)
byPoints_3 = PolyCurve.ByPoints(points=startPoint_3, connectLastToFirst=boolean_3)
code_block_23 = CodeBlock { 100; }
offset_4 = Curve.Offset(curve=byPoints_3, distance=code_block_23)
code_block_24 = CodeBlock { 0.5; }
normalAtParameter_4 = Surface.NormalAtParameter(surface=flatten_7, u=code_block_24, v=code_block_24)
Z_4 = Vector.Z(vector=normalAtParameter_4)
watch_11 = Watch(Z_4)
code_block_25 = CodeBlock(z=watch_11) { z>0; }
reverse_2 = Vector.Reverse(vector=normalAtParameter_4)
if_2 = If(test=code_block_25, true=reverse_2, false=normalAtParameter_4)
code_block_26 = CodeBlock { 200; }
extrudeAsSolid_2 = Curve.ExtrudeAsSolid(curve=offset_4, direction=if_2, distance=code_block_26)
