# Dynamo graph Str Framing Calculator_HEC(0713).dyn (Dynamo 2.10.1.3976)

# group: Str Framing
code_block = CodeBlock {  }
code_block_2 = CodeBlock {  }

# group: select all Category element
categories = Categories("OST_StructuralFraming")
all_elements_of_category = ElementsOfCategory(Category=categories)
code_block_3 = CodeBlock { "Reference Level"; }
parameterByName = Parameter.ParameterByName(element=all_elements_of_category, name=code_block_3)
string_from_object = FromObject(object=parameterByName)
uniqueItems = List.UniqueItems(list=string_from_object)
code_block_4 = CodeBlock(i=string_from_object, j=uniqueItems) { i == j[0]; }
filterByBoolMask = List.FilterByBoolMask(list=all_elements_of_category, mask=code_block_4)

# group: Concrete - Steel 부재 구분
watch = Watch(all_elements_of_category)
elementType = Element.ElementType(element=watch)
familyName = ElementType.FamilyName(elementType=elementType)
watch_2 = Watch(familyName)
string_from_object_2 = FromObject(object=watch_2)
code_block_5 = CodeBlock { "Concrete"; }
contains = String.Contains(str=string_from_object_2, searchFor=code_block_5)
filterByBoolMask_2 = List.FilterByBoolMask(list=all_elements_of_category, mask=contains)

# group: Steel Family
watch_3 = Watch(filterByBoolMask_2.out)
name = FamilyType.Name(familyType=watch_3)
string_from_object_3 = FromObject(object=name)
code_block_6 = CodeBlock { "BM"; }
contains_2 = String.Contains(str=string_from_object_3, searchFor=code_block_6)
filterByBoolMask_3 = List.FilterByBoolMask(list=watch_3, mask=contains_2)
watch_4 = Watch(filterByBoolMask_3.in)
# note: Preview
geometry = Element.Geometry(element=watch_4)
watch_5 = Watch(geometry)
watch_6 = Watch(filterByBoolMask_3.out)

# group: Built-up 자재 구분 추후 작성
code_block_7 = CodeBlock { UW; }  # unwired: UW
code_block_8 = CodeBlock { 90; 30; }
# note: Built up 제외외
ge = code_block_7 >= code_block_8.out0
lt = code_block_7 < code_block_8.out1
ge_2 = code_block_7 >= code_block_8.out1
# note: Built up 자제만
watch_7 = Watch(ge_2)
le = watch_7 <= code_block_8.out0

watch_8 = Watch(watch_4)

# group: Mass per Unit Length (kg/m) 추출
elementType_2 = Element.ElementType(element=watch_8)
list_create = List.Create(item0=elementType_2)
code_block_9 = CodeBlock { "Mass per Unit Length"; }
getParameterValueByName = Element.GetParameterValueByName(element=elementType_2, parameterName=code_block_9)

# group: Length(mm) 추출
code_block_10 = CodeBlock { "Length"; }
getParameterValueByName_2 = Element.GetParameterValueByName(element=watch_8, parameterName=code_block_10)

# group: Steel 중량 산출 (Ton) Unit Weight x Length
code_block_11 = CodeBlock(i=getParameterValueByName_2) { i[]*0.001; }
# note: 단위변환 kg -> ton
# note: 단위변환 mm -> m
code_block_12 = CodeBlock(i=getParameterValueByName) { i[]*0.001; }
mul = code_block_11 * code_block_12

code_block_13 = CodeBlock {  }
code_block_14 = CodeBlock {  }

# group: preview
geometry_2 = Element.Geometry(element=all_elements_of_category)

# group: Concrete Family
watch_9 = Watch(filterByBoolMask_2.in)
# note: Preview
geometry_3 = Element.Geometry(element=watch_9)
watch_10 = Watch(geometry_3)

# group: UG/AG 구분
string_from_object_4 = FromObject(object=watch_9)
code_block_15 = CodeBlock { "UG"; }
contains_3 = String.Contains(str=string_from_object_4, searchFor=code_block_15)
filterByBoolMask_4 = List.FilterByBoolMask(list=watch_9, mask=contains_3)

# group: UG Concrete Family
watch_11 = Watch(filterByBoolMask_4.in)
# note: Preview
geometry_4 = Element.Geometry(element=watch_11)

# group: 측면 추출 (UG)
watch_12 = Watch(watch_11)
faces = Element.Faces(element=watch_12)
code_block_16 = CodeBlock { 0.5; }
normalAtParameter = Surface.NormalAtParameter(surface=faces, u=code_block_16, v=code_block_16)
Z = Vector.Z(vector=normalAtParameter)
round = Math.Round(number=Z)
code_block_17 = CodeBlock(a=round) { a==0; a>0; a<0; a==-1; }
filterByBoolMask_5 = List.FilterByBoolMask(list=faces, mask=code_block_17.out0)
watch_13 = Watch(filterByBoolMask_5.in)
flatten = List.Flatten(list=faces)

# group: UG 측면 Surface Area (Concrete) - m2
watch_14 = Watch(watch_13)
area = Surface.Area(surface=watch_14)
# note: 단위조정(mm2 -> m2)
code_block_18 = CodeBlock(i=area) { i/1000000; }
sum = Math.Sum(values=code_block_18@L2)

# group: UG Volume (Concrete) - m3
watch_15 = Watch(watch_12)
solids = Element.Solids(element=watch_15)
volume = Solid.Volume(solid=solids)
# note: 단위조정(mm3 -> m3)
code_block_19 = CodeBlock(i=volume) { i/1000000000; }
watch_16 = Watch(code_block_19)

# group: AG Concrete Family
watch_17 = Watch(filterByBoolMask_4.out)
# note: Preview
geometry_5 = Element.Geometry(element=watch_17)

# group: 측면 추출Preview
code_block_20 = CodeBlock(i=watch_13) { i[0]; }

# group: 측면, 하부면 추출(AG)
watch_18 = Watch(watch_17)
faces_2 = Element.Faces(element=watch_18)
flatten_2 = List.Flatten(list=faces_2)
code_block_21 = CodeBlock { 0.5; }
normalAtParameter_2 = Surface.NormalAtParameter(surface=faces_2, u=code_block_21, v=code_block_21)
Z_2 = Vector.Z(vector=normalAtParameter_2)
round_2 = Math.Round(number=Z_2)
code_block_22 = CodeBlock(a=round_2) { a<=0; a>0; a<0; a==-1; }
filterByBoolMask_6 = List.FilterByBoolMask(list=faces_2, mask=code_block_22.out0)
watch_19 = Watch(filterByBoolMask_6.in)

code_block_23 = CodeBlock(i=watch_19) { i[0]; }

# group: AG 측면,하부면 Surface Area (Concrete) - m2
watch_20 = Watch(watch_19)
area_2 = Surface.Area(surface=watch_20)
# note: 단위조정(mm2 -> m2)
code_block_24 = CodeBlock(i=area_2) { i/1000000; }
sum_2 = Math.Sum(values=code_block_24@L2)

# group: AG Volume (Concrete) - m3
watch_21 = Watch(watch_18)
solids_2 = Element.Solids(element=watch_21)
volume_2 = Solid.Volume(solid=solids_2)
# note: 단위조정(mm3 -> m3)
code_block_25 = CodeBlock(i=volume_2) { i/1000000000; }
watch_22 = Watch(code_block_25)

# group: 예시) Family
watch_23 = Watch(filterByBoolMask_2.out)
name_2 = FamilyType.Name(familyType=watch_23)
uniqueItems_2 = List.UniqueItems(list=name_2)
code_block_26 = CodeBlock(i=uniqueItems_2) { i[1]; }
contains_4 = String.Contains(str=name_2, searchFor=code_block_26)
filterByBoolMask_7 = List.FilterByBoolMask(list=watch_23, mask=contains_4)
watch_24 = Watch(filterByBoolMask_7.out)
watch_25 = Watch(filterByBoolMask_7.in)
# note: Preview
geometry_6 = Element.Geometry(element=watch_25)
watch_26 = Watch(geometry_6)

# group: Surface Area (m2/m) 추출
elementType_3 = Element.ElementType(element=watch_8)
list_create_2 = List.Create(item0=elementType_3)
code_block_27 = CodeBlock { "Surface Area"; }
getParameterValueByName_3 = Element.GetParameterValueByName(element=elementType_3, parameterName=code_block_27)

# group: Steel Surface Area 물량 (m2) Unit Weight x Length (Ton)
# note: 단위변환 mm -> m
code_block_28 = CodeBlock(i=getParameterValueByName_2) { i[]*0.001; }
mul_2 = code_block_28 * getParameterValueByName_3

watch_27 = Watch(watch_25)

# group: Mass per Unit Length (kg/m) 추출
elementType_4 = Element.ElementType(element=watch_27)
list_create_3 = List.Create(item0=elementType_4)
code_block_29 = CodeBlock { "Mass per Unit Length"; }
getParameterValueByName_4 = Element.GetParameterValueByName(element=elementType_4, parameterName=code_block_29)

# group: Surface Area (m2/m) 추출
elementType_5 = Element.ElementType(element=watch_27)
list_create_4 = List.Create(item0=elementType_5)
code_block_30 = CodeBlock { "Surface Area"; }
getParameterValueByName_5 = Element.GetParameterValueByName(element=elementType_5, parameterName=code_block_30)

# group: Length(mm) 추출
code_block_31 = CodeBlock { "Length"; }
getParameterValueByName_6 = Element.GetParameterValueByName(element=watch_27, parameterName=code_block_31)

# group: Steel Surface Area 물량 (m2) Unit Weight x Length (Ton)
# note: 단위변환 mm -> m
code_block_32 = CodeBlock(i=getParameterValueByName_6) { i[]*0.001; }
mul_3 = code_block_32 * getParameterValueByName_5
watch_28 = Watch(mul_3)

name_3 = Element.Name(element=watch_27)
code_block_33 = CodeBlock(i=name_3) { i; }

# group: Steel 중량 산출 (Ton) Unit Weight x Length
code_block_34 = CodeBlock(i=getParameterValueByName_6) { i[]*0.001; }
# note: 단위변환 kg -> ton
# note: 단위변환 mm -> m
code_block_35 = CodeBlock(i=getParameterValueByName_4) { i[]*0.001; }
mul_4 = code_block_34 * code_block_35
watch_29 = Watch(mul_4)

code_block_36 = CodeBlock(a=code_block_33, b=watch_29) { a+"_"+b; }
watch_30 = Watch(code_block_36)

# group: Excel Import
file_path = Filename(".\BIM_물량집계 자동화 산출기준표_rC(20210713)_KCS.xlsx")
file_from_path = FileObject(path=file_path)
string_from_object_5 = FromObject(object=file_from_path)
code_block_37 = CodeBlock { "Scope_lv2(Str Framing)"; }
python_script_import_excel_by = Python(IN[0]=string_from_object_5, IN[1]=code_block_37)  # "Python Script@Import Excel(By OpenpyXl)"; CPython3
# ---------- python_script_import_excel_by.python (50 lines) ----------
# Load the Python Standard and DesignScript Libraries
import sys
import os
#sys.path.append(r'C:\Users\HEC\AppData\Local\Programs\Python\Python39\Lib\site-packages')
#sys.path.append(r'C:\Users\pjmk0\AppData\Local\Programs\Python\Python39\Lib\site-packages')
sys.path.append(os.getenv('LOCALAPPDATA').replace('\\','\\\\') + r'\Programs\Python\Python39\Lib\site-packages')
import clr
clr.AddReference('ProtoGeometry')
from Autodesk.DesignScript.Geometry import *
from collections import Iterable

def iterable(obj):
    return isinstance(obj, Iterable)


# The inputs to this node will be stored as a list in the IN variables.
dataEnteringNode = IN
PathIn = IN[0]
SheetNameIn = IN[1]

# Place your code below this line
import datetime
import openpyxl

path = (PathIn)
#path = (r'C:\Users\pjmk0\Downloads\MK\mQ\BIM_물량집계 자동화 산출기준표_rC(20210607)_mk_de.xlsx')

wb_obj = openpyxl.load_workbook(path, data_only=True)
sheet_obj = wb_obj.get_sheet_by_name(SheetNameIn)

m_row = sheet_obj.max_row
m_col = sheet_obj.max_column

listOut = []



for i in range(1, m_row +1):
    listTemp = []
    for j in range(1, m_col + 1):
        cell_obj = sheet_obj.cell(row=i, column=j)
        listTemp.append(cell_obj.value)
        if len(listTemp) == m_col:
            listOut.append(listTemp)
        


# Assign your output to the OUT variable.
OUT = listOut
#OUT = os.getenv('APPDATA')
# ----------------------------------------
code_block_38 = CodeBlock { false; }
importExcel = Data.ImportExcel(file=file_from_path, sheetName=code_block_37, showExcel=code_block_38)  # frozen

# group: Null값 처리
code_block_39 = CodeBlock { " "; }
isNull = Object.IsNull()  # unwired: object
replaceByCondition = Replace(item=python_script_import_excel_by, replaceWith=code_block_39, condition=isNull)

# group: Whole Data(Column direction)
transpose = List.Transpose(lists=replaceByCondition)
watch_31 = Watch(transpose)

# group: Whole Data(row direction)
watch_32 = Watch(replaceByCondition)

# group: Column Index Guide
code_block_40 = CodeBlock(i=watch_32) { i[3]; }
watch_33 = Watch(code_block_40)

# group: All Elements of Category
watch_all_elements_of_category = Watch()  # "Watch@All Elements of Category - WALLS"; unwired: arg0

# group: 모델링에 사용된 모든 패밀리타입 코드 추출
name_4 = Element.Name(element=watch_all_elements_of_category)
uniqueItems_3 = List.UniqueItems(list=name_4@L2)
flatten_3 = List.Flatten(list=uniqueItems_3)
watch_34 = Watch(flatten_3)
code_block_41 = CodeBlock { "_"; }
split = String.Split(str=watch_34, separator0=code_block_41)
firstItem = List.FirstItem(list=split@L2)

# group: 사용된 패밀리타입이 위치한 Column Index 추출
string_from_object_6 = FromObject(object=watch_33)
contains_5 = String.Contains(searchFor=firstItem, lacing=CrossProduct)  # unwired: str
map = List.Map(list=string_from_object_6, function=contains_5)
allFalse = List.AllFalse(list=map@L2)
code_block_42 = CodeBlock(i=allFalse) { i==false?true:false; }
code_block_43 = CodeBlock { true; }
allIndicesOf = List.AllIndicesOf(list=code_block_42, item=code_block_43)

# group: 사용된 패밀리타입 Column Data 추출
watch_35 = Watch(allIndicesOf)
getItemAtIndex = List.GetItemAtIndex(list=watch_31, index=watch_35)
code_block_44 = CodeBlock { 4; ""; }
# note: 불필요 정보 처리
replaceItemAtIndex = List.ReplaceItemAtIndex(list=getItemAtIndex@L2, index=code_block_44.out0, item=code_block_44.out1)
watch_36 = Watch(getItemAtIndex)

whole_data_row_direction = Object.Identity(object=watch_32)

# group: 사용된 패밀리 타입에서 세부코드가 기입된 Row 열 번호 추출
string_from_object_7 = FromObject(object=replaceItemAtIndex)
code_block_45 = CodeBlock { "000"; }
contains_6 = String.Contains(str=string_from_object_7@L2, searchFor=code_block_45, lacing=CrossProduct)
code_block_46 = CodeBlock { true; }
allIndicesOf_2 = List.AllIndicesOf(list=contains_6@L2, item=code_block_46)
watch_37 = Watch(allIndicesOf_2)

# group: WM code 추출
watch_38 = Watch(replaceItemAtIndex)
whole_data_row_direction_2 = Object.Identity(object=whole_data_row_direction)
getItemAtIndex_2 = List.GetItemAtIndex(list=whole_data_row_direction_2, index=watch_37@L2)
watch_39 = Watch(getItemAtIndex_2)
code_block_47 = CodeBlock { 3; }
getItemAtIndex_3 = List.GetItemAtIndex(list=watch_39@@L2, index=code_block_47)
watch_40 = Watch(getItemAtIndex_3)
code_block_48 = CodeBlock { 2; }
getItemAtIndex_4 = List.GetItemAtIndex(list=watch_39@@L2, index=code_block_48)
watch_41 = Watch(getItemAtIndex_4)
code_block_49 = CodeBlock(i=whole_data_row_direction_2) { i[3]; }
watch_42 = Watch(code_block_49)
code_block_50 = CodeBlock { 0; }
getItemAtIndex_5 = List.GetItemAtIndex(list=watch_39@@L2, index=code_block_50)
watch_43 = Watch(getItemAtIndex_5)
getItemAtIndex_6 = List.GetItemAtIndex(list=watch_38@@L2, index=watch_37@L2)
watch_44 = Watch(getItemAtIndex_6)
code_block_51 = CodeBlock(i=watch_43, j=watch_44) { i + "-" + j; }
code_block_52 = CodeBlock { 4; }
getItemAtIndex_7 = List.GetItemAtIndex(list=watch_39@@L2, index=code_block_52)
watch_45 = Watch(getItemAtIndex_7)

# group: Family Type: WM Code 딕셔너리 생성(모델링에 포함 되지 않은 WM code 까지 포함되어야함)
code_block_53 = CodeBlock { 3; }
getItemAtIndex_8 = List.GetItemAtIndex(list=watch_38@L2, index=code_block_53)
code_block_54 = CodeBlock { "_"; "-"; }
split_2 = String.Split(str=getItemAtIndex_8, separator0=code_block_54.out0, separator1=code_block_54.out1)
firstItem_2 = List.FirstItem(list=split_2@L2)
byKeysValues = DesignScript.Builtin.Dictionary.ByKeysValues(keys=firstItem_2)  # unwired: values
byKeysValues_2 = DesignScript.Builtin.Dictionary.ByKeysValues(keys=firstItem_2, values=code_block_51)
watch_46 = Watch(byKeysValues_2)

# group: D. Family Type
watch_all_elements_of_category_2 = Watch(watch_all_elements_of_category)  # "Watch@All Elements of Category - WALLS"
name_5 = Element.Name(element=watch_all_elements_of_category_2)

# group: material inform from excel sheet <per family type>
watch_47 = Watch(watch_46)

# group: material inform from excel sheet <per element>
name_6 = Element.Name(element=watch_all_elements_of_category_2)
keys = DesignScript.Builtin.Dictionary.Keys(dictionary=watch_47)
contains_7 = String.Contains(str=name_6, searchFor=keys, lacing=CrossProduct)
code_block_55 = CodeBlock { true; }
allIndicesOf_3 = List.AllIndicesOf(list=contains_7@L2, item=code_block_55)
flatten_4 = List.Flatten(list=allIndicesOf_3)
getItemAtIndex_9 = List.GetItemAtIndex(list=keys, index=flatten_4)
valueAtKey = DesignScript.Builtin.Dictionary.ValueAtKey(dictionary=watch_47, key=getItemAtIndex_9)

# group: WorkMaster 미포함 객체 제외(임시)
anyTrue = List.AnyTrue(list=contains_7@L2)
filterByBoolMask_8 = List.FilterByBoolMask(list=watch_all_elements_of_category_2, mask=anyTrue)

# group: material inform from modeling <per element>
getMaterials = Element.GetMaterials(element=filterByBoolMask_8.in)
name_7 = Element.Name(element=getMaterials)
code_block_56 = CodeBlock { "_"; }
split_3 = String.Split(str=name_7, separator0=code_block_56)
firstItem_3 = List.FirstItem(list=split_3@L2)
count = List.Count(list=getMaterials@L2)
chop = List.Chop(list=firstItem_3, lengths=count)

# group: 합집합
list_create_5 = List.Create(item0=chop, item1=valueAtKey)
transpose_2 = List.Transpose(lists=list_create_5)
watch_48 = Watch(transpose_2)
code_block_57 = CodeBlock { 1; }
flatten_5 = List.Flatten(list=watch_48@L3, amt=code_block_57)

# group: WM 중복제거
uniqueItems_4 = List.UniqueItems(list=flatten_5@L2)

# group: Row Index Guide
code_block_58 = CodeBlock(i=watch_31) { i[3]; }
watch_49 = Watch(code_block_58)

# group: C. Category
code_block_59 = CodeBlock { "Category"; }
getParameterValueByName_7 = Element.GetParameterValueByName(element=watch_all_elements_of_category, parameterName=code_block_59)
