# Dynamo graph Wall Calculator_HEC(0709).dyn (Dynamo 2.10.1.3976)
# packages: archi-lab.net 2022.210.2122

# group: select all Category element
categories = Categories("OST_Walls")
all_elements_of_category = ElementsOfCategory(Category=categories)

# group: select all Category element by level
code_block = CodeBlock { "Base Constraint"; }
getParameterValueByName = Element.GetParameterValueByName(parameterName=code_block)  # unwired: element
groupByFunction = List.GroupByFunction(list=all_elements_of_category, groupFunction=getParameterValueByName)

# group: Family Type 별 sorting
elementType = Element.ElementType()  # unwired: element
uniqueItems = List.UniqueItems(list=elementType)
groupByFunction_2 = List.GroupByFunction(list=groupByFunction@L2, groupFunction=uniqueItems)

getMaterials = Element.GetMaterials(element=groupByFunction_2)

# group: material inform from modeling <per element>
getMaterials_2 = Element.GetMaterials(element=all_elements_of_category)
name = Element.Name(element=getMaterials_2)
code_block_2 = CodeBlock { "_"; }
split = String.Split(str=name, separator0=code_block_2)
firstItem = List.FirstItem(list=split@L2)
count = List.Count(list=getMaterials_2@L2)
chop = List.Chop(list=firstItem, lengths=count)

# group: Excel Import
file_path = Filename("..\BIM_물량집계 자동화 산출기준표_rC(20210607)_mk_de.xlsx")
file_from_path = FileObject(path=file_path)
string_from_object = FromObject(object=file_from_path)
python_script_import_excel_by = Python(IN[0]=string_from_object)  # "Python Script@Import Excel(By OpenpyXl)"; CPython3
# ---------- python_script_import_excel_by.python (49 lines) ----------
# Load the Python Standard and DesignScript Libraries
import sys
import os
#sys.path.append(r'C:\Users\HEC\AppData\Local\Programs\Python\Python39\Lib\site-packages')
#sys.path.append(r'C:\Users\pjmk0\AppData\Local\Programs\Python\Python39\Lib\site-packages')
sys.path.append(os.getenv('LOCALAPPDATA').replace('\\','\\\\') + r'\Programs\Python\Python39\Lib\site-packages')
import clr
clr.AddReference('ProtoGeometry')
from Autodesk.DesignScript.Geometry import *
from collections import Iterable

def iterable(obj):
    return isinstance(obj, Iterable)


# The inputs to this node will be stored as a list in the IN variables.
dataEnteringNode = IN
PathIn = IN[0]

# Place your code below this line
import datetime
import openpyxl

path = (PathIn)
#path = (r'C:\Users\pjmk0\Downloads\MK\mQ\BIM_물량집계 자동화 산출기준표_rC(20210607)_mk_de.xlsx')

wb_obj = openpyxl.load_workbook(path, data_only=True)
sheet_obj = wb_obj.active

m_row = sheet_obj.max_row
m_col = sheet_obj.max_column

listOut = []



for i in range(1, m_row +1):
    listTemp = []
    for j in range(1, m_col + 1):
        cell_obj = sheet_obj.cell(row=i, column=j)
        listTemp.append(cell_obj.value)
        if len(listTemp) == m_col:
            listOut.append(listTemp)
        


# Assign your output to the OUT variable.
OUT = listOut
#OUT = os.getenv('APPDATA')
# ----------------------------------------
code_block_3 = CodeBlock { "Scope_lv2(Walls)"; }
code_block_4 = CodeBlock { false; }
importExcel = Data.ImportExcel(file=file_from_path, sheetName=code_block_3, showExcel=code_block_4)  # frozen

# group: Null값 처리
code_block_5 = CodeBlock { " "; }
isNull = Object.IsNull()  # unwired: object
replaceByCondition = Replace(item=python_script_import_excel_by, replaceWith=code_block_5, condition=isNull)

# group: Whole Data(Column direction)
transpose = List.Transpose(lists=replaceByCondition)
watch = Watch(transpose)

# group: Whole Data(row direction)
watch_2 = Watch(replaceByCondition)

# group: Column Index Guide
code_block_6 = CodeBlock(i=watch_2) { i[3]; }
watch_3 = Watch(code_block_6)

# group: 모델링에 사용된 모든 패밀리타입 코드 추출
elementType_2 = Element.ElementType(element=all_elements_of_category)
name_2 = Element.Name(element=elementType_2)
uniqueItems_2 = List.UniqueItems(list=name_2@L2)
flatten = List.Flatten(list=uniqueItems_2)
watch_4 = Watch(flatten)
code_block_7 = CodeBlock { "_"; }
split_2 = String.Split(str=watch_4, separator0=code_block_7)
firstItem_2 = List.FirstItem(list=split_2@L2)

# group: 사용된 패밀리타입이 위치한 Column Index 추출
string_from_object_2 = FromObject(obj=watch_3)
contains = String.Contains(searchFor=firstItem_2, lacing=CrossProduct)  # unwired: str
map = List.Map(list=string_from_object_2, f_x=contains)
allFalse = List.AllFalse(list=map@L2)
code_block_8 = CodeBlock(i=allFalse) { i==false?true:false; }
code_block_9 = CodeBlock { true; }
allIndicesOf = List.AllIndicesOf(list=code_block_8, item=code_block_9)

# group: 사용된 패밀리타입 Column Data 추출
watch_5 = Watch(allIndicesOf)
getItemAtIndex = List.GetItemAtIndex(list=watch, index=watch_5)
code_block_10 = CodeBlock { 4; ""; }
# note: 불필요 정보 처리
replaceItemAtIndex = List.ReplaceItemAtIndex(list=getItemAtIndex@L2, index=code_block_10.out0, item=code_block_10.out1)
watch_6 = Watch(getItemAtIndex)

identity = Object.Identity(object=watch_2)

# group: 사용된 패밀리 타입에서 세부코드가 기입된 Row 열 번호 추출
string_from_object_3 = FromObject(obj=replaceItemAtIndex)
code_block_11 = CodeBlock { "000"; }
contains_2 = String.Contains(str=string_from_object_3@L2, searchFor=code_block_11, lacing=CrossProduct)
code_block_12 = CodeBlock { true; }
allIndicesOf_2 = List.AllIndicesOf(list=contains_2@L2, item=code_block_12)
watch_7 = Watch(allIndicesOf_2)

# group: WM code 추출
watch_8 = Watch(replaceItemAtIndex)
identity_2 = Object.Identity(object=identity)
getItemAtIndex_2 = List.GetItemAtIndex(list=identity_2, index=watch_7@L2)
watch_9 = Watch(getItemAtIndex_2)
code_block_13 = CodeBlock { 0; }
getItemAtIndex_3 = List.GetItemAtIndex(list=watch_9@@L2, index=code_block_13)
watch_10 = Watch(getItemAtIndex_3)
getItemAtIndex_4 = List.GetItemAtIndex(list=watch_8@L2, index=watch_7@L2)
watch_11 = Watch(getItemAtIndex_4)
code_block_14 = CodeBlock(i=watch_10, j=watch_11) { i + "-" + j; }
code_block_15 = CodeBlock(i=identity_2) { i[3]; }
watch_12 = Watch(code_block_15)
code_block_16 = CodeBlock { 2; }
getItemAtIndex_5 = List.GetItemAtIndex(list=watch_9@@L2, index=code_block_16)
watch_13 = Watch(getItemAtIndex_5)
code_block_17 = CodeBlock { 3; }
getItemAtIndex_6 = List.GetItemAtIndex(list=watch_9@@L2, index=code_block_17)
watch_14 = Watch(getItemAtIndex_6)
code_block_18 = CodeBlock { 4; }
getItemAtIndex_7 = List.GetItemAtIndex(list=watch_9@@L2, index=code_block_18)
watch_15 = Watch(getItemAtIndex_7)

# group: Wall Type: WM Code 딕셔너리 생성(벽체 layer에 포함 되지 않은 WM code 까지 포함되어야함)
code_block_19 = CodeBlock { 3; }
getItemAtIndex_8 = List.GetItemAtIndex(list=watch_8@L2, index=code_block_19)
code_block_20 = CodeBlock { "_"; "-"; }
split_3 = String.Split(str=getItemAtIndex_8, separator0=code_block_20.out0, separator1=code_block_20.out1)
firstItem_3 = List.FirstItem(list=split_3@L2)
byKeysValues = DesignScript.Builtin.Dictionary.ByKeysValues(keys=firstItem_3, values=code_block_14)
watch_16 = Watch(byKeysValues)

# group: material inform from excel sheet <per family type>
watch_17 = Watch(watch_16)

# group: D. Family Type
elementType_3 = Element.ElementType(element=all_elements_of_category)
name_3 = Element.Name(element=elementType_3)

# group: material inform from excel sheet <per element>
keys = DesignScript.Builtin.Dictionary.Keys(dictionary=watch_17)
name_4 = Element.Name(element=elementType_3)
contains_3 = String.Contains(str=name_4, searchFor=keys, lacing=CrossProduct)
code_block_21 = CodeBlock { true; }
allIndicesOf_3 = List.AllIndicesOf(list=contains_3@L2, item=code_block_21)
flatten_2 = List.Flatten(list=allIndicesOf_3)
getItemAtIndex_9 = List.GetItemAtIndex(list=keys, index=flatten_2)
valueAtKey = DesignScript.Builtin.Dictionary.ValueAtKey(dictionary=watch_17, key=getItemAtIndex_9)

# group: 합집합
add = _ + _  # unwired: x, y
code_block_22 = CodeBlock { "..."; }
add_2 = chop@L2 + code_block_22
combine = List.Combine(combineFunction=add, list0=add_2, list1=valueAtKey)
isNull_2 = Object.IsNull(object=combine)
anyTrue = List.AnyTrue(list=isNull_2@L2)
code_block_23 = CodeBlock { true; }
allIndicesOf_4 = List.AllIndicesOf(list=anyTrue, item=code_block_23)
removeItemAtIndex = List.RemoveItemAtIndex(list=combine, indices=allIndicesOf_4)
code_block_24 = CodeBlock { "..."; }
split_4 = String.Split(str=removeItemAtIndex, separator0=code_block_24)
code_block_25 = CodeBlock { 1; }
flatten_3 = List.Flatten(list=split_4@L3, amt=code_block_25)

# group: WM 중복제거
uniqueItems_3 = List.UniqueItems(list=flatten_3@L2)

# group: WM 중복제거
watch_wm_중복제거 = Watch(uniqueItems_3)

# group: element-wm 별 면적(m2) 물량 추출 구간
code_block_26 = CodeBlock { "Area"; }
getParameterValueByName_2 = Element.GetParameterValueByName(element=groupByFunction_2, parameterName=code_block_26)
flatten_4 = List.Flatten(list=getParameterValueByName_2)
watch_18 = Watch(flatten_4)
count_2 = List.Count(list=watch_wm_중복제거@L2)
ofRepeatedItem = List.OfRepeatedItem(item=watch_18, amount=count_2, lacing=Shortest)
flatten_5 = List.Flatten(list=ofRepeatedItem)

watch_19 = Watch(flatten_5)
watch_20 = Watch(watch_wm_중복제거)
watch_21 = Watch(watch_20)
flatten_6 = List.Flatten(list=watch_21)

# group: input list 에서 대상문자열들 포함하는 index 추출(for line base)
대상_문자열 = CodeBlock()
# ---------- 대상_문자열.designscript (5 lines) ----------
[

"A04AL081"

];
# ----------------------------------------
code_block_27 = CodeBlock(str=flatten_6, searchFor=대상_문자열) { String.Contains(str<1>, searchFor, false); }
allFalse_2 = List.AllFalse(list=code_block_27@L2)
code_block_28 = CodeBlock { false; }
allIndicesOf_5 = List.AllIndicesOf(list=allFalse_2, item=code_block_28)

# group: element-wm 별 길이(m) 물량 추출 구간
code_block_29 = CodeBlock { "Length"; }
getParameterValueByName_3 = Element.GetParameterValueByName(element=groupByFunction_2, parameterName=code_block_29)
flatten_7 = List.Flatten(list=getParameterValueByName_3)
watch_22 = Watch(flatten_7)
getMaterials_3 = Element.GetMaterials(element=groupByFunction_2)
count_3 = List.Count(list=getMaterials_3@L2)
ofRepeatedItem_2 = List.OfRepeatedItem(item=watch_22, amount=count_3, lacing=Shortest)
flatten_8 = List.Flatten(list=ofRepeatedItem_2)

code_block_30 = CodeBlock(i=flatten_8) { i / 1000; }
watch_23 = Watch(code_block_30)

# group: element-wm 별 적합 물량 매칭 구간 (unit:m2 base, unit:m modify)
watch_24 = Watch(flatten_5)
watch_25 = Watch(allIndicesOf_5)
getItemAtIndex_10 = List.GetItemAtIndex(list=watch_23, index=allIndicesOf_5)
watch_26 = Watch(getItemAtIndex_10)
code_block_31 = CodeBlock(inList=watch_24, replaceIndex=watch_25, replaceValue=watch_26)
# ---------- code_block_31.designscript (6 lines) ----------
numIndex = 0..List.Count(inList)-1;
numIndexDiffer = List.SetDifference(numIndex,replaceIndex);
numIndexFlatten = List.Flatten([numIndexDiffer,replaceIndex],-1);
bln1 = List.Contains(replaceIndex,numIndex<1>);
outList = List.FilterByBoolMask(inList,bln1);
outListFlatten = List.Flatten([outList["out"],replaceValue],-1);
# ----------------------------------------
watch_27 = Watch(code_block_31.bln1)
watch_28 = Watch(code_block_31.outList)
sortByKey = List.SortByKey(list=code_block_31.outListFlatten, keys=code_block_31.numIndexFlatten)
watch_29 = Watch(sortByKey.sortedList)

# group: element 별 위치정보 삽입 구간
code_block_32 = CodeBlock {  }
code_block_33 = CodeBlock {  }

# group: wm 별 할증값 생성구간
code_block_34 = CodeBlock {  }
code_block_35 = CodeBlock {  }

rank = List.Rank(list=watch_21@L3)
watch_30 = Watch(firstItem_2)

# group: Family Type 별 sorting
elementType_4 = Element.ElementType()  # unwired: element
uniqueItems_4 = List.UniqueItems(list=elementType_4)
groupByFunction_3 = List.GroupByFunction(list=all_elements_of_category@L2, groupFunction=uniqueItems_4)

byKeysValues_2 = DesignScript.Builtin.Dictionary.ByKeysValues(keys=watch_30, values=groupByFunction_3@L3)
components = DesignScript.Builtin.Dictionary.Components(dictionary=byKeysValues_2)

# group: select all Category element by level
code_block_36 = CodeBlock { "Base Constraint"; }
getParameterValueByName_4 = Element.GetParameterValueByName(parameterName=code_block_36)  # unwired: element
groupByFunction_4 = List.GroupByFunction(list=components.values@L2, groupFunction=getParameterValueByName_4)

byKeysValues_3 = DesignScript.Builtin.Dictionary.ByKeysValues(keys=components.keys, values=components.values@L3)
count_4 = List.Count(list=ofRepeatedItem_2@L2)
sublists = List.Sublists(list=code_block_30, ranges=count_4)  # unwired: offset

# group: Row Index Guide
code_block_37 = CodeBlock(i=watch) { i[3]; }
watch_31 = Watch(code_block_37)

parameters = Element.Parameters(element=groupByFunction_2)
watch_32 = Watch(parameters)

# group: grid개체
categories_2 = Categories("OST_Grids")
all_elements_of_category_2 = ElementsOfCategory(Category=categories_2)
parameters_2 = Element.Parameters(element=all_elements_of_category_2)
name_5 = Element.Name(element=all_elements_of_category_2)
geometry = Element.Geometry(element=all_elements_of_category_2)

code_block_38 = CodeBlock {  }
code_block_39 = CodeBlock {  }

# group: C. Category
code_block_40 = CodeBlock { "Category"; }
getParameterValueByName_5 = Element.GetParameterValueByName(element=all_elements_of_category, parameterName=code_block_40)

parameters_3 = Element.Parameters(element=all_elements_of_category)
identity_3 = Object.Identity(object=groupByFunction_2)
identity_4 = Object.Identity(object=identity_3)
count_5 = List.Count(list=watch_wm_중복제거@L2)
identity_5 = Object.Identity(object=count_5)

# group: input list 에서 대상문자열들 포함하는 index 추출(for forms)
대상_문자열_2 = CodeBlock()
# ---------- 대상_문자열_2.designscript (7 lines) ----------
[

"A03AD036",//Form
"A04AS164"//Plastering


];
# ----------------------------------------
code_block_41 = CodeBlock(str=flatten_6, searchFor=대상_문자열_2) { String.Contains(str<1>, searchFor, false); }
allFalse_3 = List.AllFalse(list=code_block_41@L2)
code_block_42 = CodeBlock { false; }
allIndicesOf_6 = List.AllIndicesOf(list=allFalse_3, item=code_block_42)

element_wm_별_면적_형상 = CodeBlock(i=flatten_5) { i; }

# group: element-wm 별 적합 물량 매칭 구간(벽체 양쪽 적용 WM Code modify)
watch_33 = Watch(watch_29)
watch_34 = Watch(allIndicesOf_6)
getItemAtIndex_11 = List.GetItemAtIndex(list=element_wm_별_면적_형상, index=allIndicesOf_6)

form_물량_보정 = CodeBlock(i=getItemAtIndex_11) { i * 2; }

# group (continued): element-wm 별 적합 물량 매칭 구간(벽체 양쪽 적용 WM Code modify)
watch_35 = Watch(form_물량_보정)
code_block_43 = CodeBlock(inList=watch_33, replaceIndex=watch_34, replaceValue=watch_35)  # same code as code_block_31
sortByKey_2 = List.SortByKey(list=code_block_43.outListFlatten, keys=code_block_43.numIndexFlatten)
watch_36 = Watch(sortByKey_2.sortedList)

# group: element 별 Family Type 삽입 구간
identity_6 = Object.Identity(object=identity_4)
elementType_5 = Element.ElementType(element=identity_6@L1)
name_6 = Element.Name(element=elementType_5)
ofRepeatedItem_3 = List.OfRepeatedItem(item=name_6, amount=identity_5, lacing=Shortest)
watch_37 = Watch(ofRepeatedItem_3)
watch_38 = Watch(watch_36)
code_block_44 = CodeBlock(i=watch_37, j=watch_38) { i + "..." + j; }

identity_7 = Object.Identity(object=flatten_6)
identity_8 = Object.Identity(object=identity_7)

# group: element 별 WM code 삽입 구간
watch_39 = Watch(code_block_44)
watch_40 = Watch(identity_8)
code_block_45 = CodeBlock(i=watch_39, j=watch_40) { i + "..." + j; }
watch_41 = Watch(code_block_45)

# group: Data arrange for excel
flatten_9 = List.Flatten(list=watch_41)
code_block_46 = CodeBlock { "..."; }
split_5 = String.Split(str=flatten_9, separator0=code_block_46)
watch_42 = Watch(split_5)

# group: Export Excel(By OpenpyXl)
python_script_export_excel_by = Python(IN[0]=watch_42)  # "Python Script@Export Excel(By OpenpyXl)"; CPython3
# ---------- python_script_export_excel_by.python (152 lines) ----------
# Load the Python Standard and DesignScript Libraries
import sys
import os
#sys.path.append(r'C:\Users\HEC\AppData\Local\Programs\Python\Python39\Lib\site-packages')
#sys.path.append(r'C:\Users\pjmk0\AppData\Local\Programs\Python\Python39\Lib\site-packages')
sys.path.append(os.getenv('LOCALAPPDATA').replace('\\','\\\\') + r'\Programs\Python\Python39\Lib\site-packages')
import clr
clr.AddReference('ProtoGeometry')
from Autodesk.DesignScript.Geometry import *
from collections import Iterable

def iterable(obj):
    return isinstance(obj, Iterable)


# The inputs to this node will be stored as a list in the IN variables.
dataEnteringNode = IN
ListIn = IN[0]

# Place your code below this line
import datetime
from datetime import date, timedelta
Today = date.today()
import openpyxl
from openpyxl.styles import Border, Side, PatternFill, Font, GradientFill, Alignment, Color, numbers

sample_items = ListIn


def write_to_file(filepath):
    wb = openpyxl.Workbook()
    for sheet in wb.sheetnames:
        wb.remove(wb[sheet])

    thin = Side(border_style="thin", color="000000")
    double = Side(border_style="double", color="000000")

    ws = wb.create_sheet(title='Wall_Calc_instance', index=0)

    ws.merge_cells('A1:L1')
    ws['A1'] = 'HEC Wall Category Calculation Sheet'
    cell = ws['A1']
    cell.font = openpyxl.styles.Font(color='000000', size=20)
    cell.fill = openpyxl.styles.fills.PatternFill(patternType='solid',
                                                  fgColor=openpyxl.styles.colors.Color(rgb='fff3b0'))

    ws['A2'] = 'Item Number'
    ws['A2'].font = openpyxl.styles.Font(b=True, color='000000', size=12)
    #ws['B2'] = 'Member Name'
    #ws['B2'].font = openpyxl.styles.Font(b=True, color='000000', size=12)
    #ws['C2'] = 'Category'
    #ws['C2'].font = openpyxl.styles.Font(b=True, color='000000', size=12)
    ws['B2'] = 'Family Type'
    ws['B2'].font = openpyxl.styles.Font(b=True, color='000000', size=12)
    ws['D2'] = 'WorkMaster Code'
    ws['D2'].font = openpyxl.styles.Font(b=True, color='000000', size=12)
    #ws['F2'] = 'WorkMaster Description'
    #ws['F2'].font = openpyxl.styles.Font(b=True, color='000000', size=12)
    #ws['G2'] = 'Unit'
    #ws['G2'].font = openpyxl.styles.Font(b=True, color='000000', size=12)
    #ws['H2'] = '계수'
    #ws['H2'].font = openpyxl.styles.Font(b=True, color='000000', size=12)
    #ws['I2'] = '계산 참조값'
    #ws['I2'].font = openpyxl.styles.Font(b=True, color='000000', size=12)
    ws['C2'] = 'Quantities'
    ws['C2'].font = openpyxl.styles.Font(b=True, color='000000', size=12)
    ws['E2'] = 'Unit Price'
    ws['E2'].font = openpyxl.styles.Font(b=True, color='000000', size=12)
    ws['F2'] = 'Total Price'
    ws['F2'].font = openpyxl.styles.Font(b=True, color='000000', size=12)


## 칼럼별 너비 조정 구간
#    for col in range(ws.max_column):
#        ws.column_dimensions[chr(ord('A') + col)].width = 15
    ws.column_dimensions['A'].width = 15
    ws.column_dimensions['B'].width = 45
    ws.column_dimensions['C'].width = 12
    ws.column_dimensions['D'].width = 20
    ws.column_dimensions['E'].width = 20
    ws.column_dimensions['F'].width = 20
    #ws.column_dimensions['G'].width = 9
    #ws.column_dimensions['H'].width = 9
    #ws.column_dimensions['H'].hidden = True
    #ws.column_dimensions['I'].width = 12
    #ws.column_dimensions['I'].hidden = True
    #ws.column_dimensions['J'].width = 12
    #ws.column_dimensions['K'].width = 12
    #ws.column_dimensions['L'].width = 12

###
    start_row = 3
    for (row, item) in enumerate(sample_items, start_row):
        cell = ws.cell(row=row, column=1, value=row - 2)
        cell.alignment = openpyxl.styles.Alignment(horizontal='center', vertical='center')

#        cell = ws.cell(row=row, column=2, value=item[0])
#        cell.number_format = openpyxl.styles.numbers.FORMAT_DATE_YYYYMMDD2  # 'yyyy-mm-dd'
        ws.cell(row=row, column=2, value=item[0]) ## Room Name 칼럼

        ws.cell(row=row, column=3, value=item[1]) ## Department 칼럼
        
        ws.cell(row=row, column=4, value=item[2]) ## Interior Finish Type 칼럼
        
        #ws.cell(row=row, column=5, value=item[3]) ## WorkMaster Code 칼럼
        
        #ws.cell(row=row, column=6, value=item[4]) ## WorkMaster Description 칼럼
        
        #ws.cell(row=row, column=7, value=item[5]) ## Unit 칼럼

        #cell = ws.cell(row=row, column=8, value=item[6]) ## 계수 칼럼
        #cell.number_format = openpyxl.styles.numbers.builtin_format_code(3)  # '#,##0'
        
        #cell = ws.cell(row=row, column=9, value=item[7]) ## 계산 참조값 칼럼
        #cell.number_format = openpyxl.styles.numbers.builtin_format_code(3)  # '#,##0'
        
        #cell = ws.cell(row=row, column=10, value=item[8]) ## Quantities 칼럼
        #cell.number_format = openpyxl.styles.numbers.builtin_format_code(3)  # '#,##0'
        #cell.font = openpyxl.styles.Font(b=True, color='000000', size=11)

        cell = ws.cell(row=row, column=6, value='= C{current_row}*E{current_row}'.format(current_row=cell.row))
        cell.number_format = '#,##0'

#        cell = ws.cell(row=row, column=6, value='= D{current_row} * E{current_row}'.format(current_row=cell.row))
#        cell.number_format = openpyxl.styles.numbers.builtin_format_code(3)

    total_row = ws.max_row + 1
    if total_row > start_row:
        cell1 = ws.cell(row=total_row, column=5, value='Total')
        cell1.font = openpyxl.styles.Font(b=True, color='000000', size=15)
        
        cell2 = ws.cell(row=total_row, column=6, value='= SUM(F{}:F{})'.format(start_row, total_row - 1))
        cell2.number_format = openpyxl.styles.numbers.builtin_format_code(3)
        cell2.border = Border(top=double, left=double, right=double, bottom=double)
        cell2.font = openpyxl.styles.Font(b=True, color='ff03ce', size=15)
    

    wb.save(filepath)
    wb.close()


##if __name__ == '__main__':
#write_to_file('C:\\Users\\pjmk0\\AppData\\Roaming\\test.xlsx')

save_name = "HecWallCalcSheet_" + Today.strftime("%Y-%m-%d")+".xlsx"
path = os.getenv('APPDATA').replace('\\','\\\\')
filePath = path + '\\' + save_name

write_to_file(filePath)

# Assign your output to the OUT variable.
OUT = os.getenv('APPDATA')
# ----------------------------------------

watch_43 = Watch(all_elements_of_category)

# group: 인덱스-엘리먼트, 인덱스-WM code 딕셔너리 형성
count_6 = List.Count(list=watch_43)
code_block_47 = CodeBlock(j=count_6) { 0..(j-1); }
string_from_object_4 = FromObject(object=code_block_47)
byKeysValues_4 = DesignScript.Builtin.Dictionary.ByKeysValues(keys=string_from_object_4, values=watch_43)
watch_44 = Watch(byKeysValues_4)
byKeysValues_5 = DesignScript.Builtin.Dictionary.ByKeysValues(keys=string_from_object_4, values=uniqueItems_3)
watch_45 = Watch(byKeysValues_5)

watch_46 = Watch(name_3)
byKeysValues_6 = DesignScript.Builtin.Dictionary.ByKeysValues(keys=string_from_object_4, values=watch_46)
watch_47 = Watch(byKeysValues_6)
valueAtKey_2 = DesignScript.Builtin.Dictionary.ValueAtKey(dictionary=watch_47, key=string_from_object_4)
code_block_48 = CodeBlock {  }
code_block_49 = CodeBlock {  }

# group: Test 구간
code_block_50 = CodeBlock {  }
code_block_51 = CodeBlock {  }

getMaterials_4 = Element.GetMaterials(element=all_elements_of_category)
parameters_4 = Element.Parameters(element=getMaterials_4)
code_block_52 = CodeBlock { "d8450ee6-31bf-3463-a189-4fd1ad506668"; }
findByGuid = archilab.Revit.Elements.Schema.FindByGuid(guid=code_block_52)
valueAtKey_3 = DesignScript.Builtin.Dictionary.ValueAtKey(dictionary=watch_44, key=string_from_object_4)
parameters_5 = Element.Parameters(element=valueAtKey_3)
valueAtKey_4 = DesignScript.Builtin.Dictionary.ValueAtKey(dictionary=watch_45, key=string_from_object_4)

# group: 산출값 List 초기화
code_block_53 = CodeBlock { "initialValue"; }
count_7 = List.Count(list=valueAtKey_4@L2)
ofRepeatedItem_4 = List.OfRepeatedItem(item=code_block_53, amount=count_7)

# group: 산출대상 WM 인덱스 넘버 추출
code_block_54 = CodeBlock { "A03AD032-00007"; }
# note: element 인덱스
allIndicesOf_7 = List.AllIndicesOf(list=valueAtKey_4@L2, item=code_block_54)
contains_4 = List.Contains(list=valueAtKey_4@L2, item=code_block_54)
code_block_55 = CodeBlock { true; }
# note: element 별 WM 인덱스
allIndicesOf_8 = List.AllIndicesOf(list=contains_4, item=code_block_55)

# group: Volume 값 추출
code_block_56 = CodeBlock { "Volume"; }
getParameterValueByName_6 = Element.GetParameterValueByName(element=valueAtKey_3, parameterName=code_block_56)
getItemAtIndex_12 = List.GetItemAtIndex(list=getParameterValueByName_6, index=allIndicesOf_8)
code_block_57 = CodeBlock { 2; }
round = Math.Round(number=getItemAtIndex_12, digits=code_block_57)

replaceItemAtIndex_2 = List.ReplaceItemAtIndex(list=ofRepeatedItem_4@L2, index=allIndicesOf_7, item=round, lacing=Longest)
isEmpty = List.IsEmpty(list=replaceItemAtIndex_2@L3)
code_block_58 = CodeBlock { true; }
allIndicesOf_9 = List.AllIndicesOf(list=isEmpty, item=code_block_58)
getItemAtIndex_13 = List.GetItemAtIndex(list=ofRepeatedItem_4, index=allIndicesOf_9)
code_block_59 = CodeBlock(i=getItemAtIndex_13) { i[0]; }
replaceItemAtIndex_3 = List.ReplaceItemAtIndex(list=replaceItemAtIndex_2@L4, index=allIndicesOf_9@L1, item=code_block_59, lacing=Shortest)
code_block_60 = CodeBlock { 1; }
flatten_10 = List.Flatten(list=replaceItemAtIndex_2@L3, amt=code_block_60)
code_block_61 = CodeBlock { 4; }
type = Object.Type(obj=watch_42)
