# Dynamo graph Wall Calculator_HEC(0710).dyn (Dynamo 2.10.1.3976)
# packages: archi-lab.net 2022.210.2122

# group: select all Category element
categories = Categories("OST_Walls")
all_elements_of_category = ElementsOfCategory(Category=categories)

watch_all_elements_of_category = Watch(all_elements_of_category)
watch_all_elements_of_category_2 = Watch(watch_all_elements_of_category)

# group: material inform from modeling <per element>
getMaterials = Element.GetMaterials(element=all_elements_of_category)
name = Element.Name(element=getMaterials)
code_block = CodeBlock { "_"; }
split = String.Split(str=name, separator0=code_block)
firstItem = List.FirstItem(list=split@L2)
count = List.Count(list=getMaterials@L2)
chop = List.Chop(list=firstItem, lengths=count)

# group: Excel Import
file_path = Filename("..\BIM_물량집계 자동화 산출기준표_rC(20210607)_mk_de.xlsx")
file_from_path = FileObject(path=file_path)
string_from_object = FromObject(object=file_from_path)
python_script_import_excel_by = Python(IN[0]=string_from_object)  # "Python Script@Import Excel(By OpenpyXl)"; CPython3
# ---------- python_script_import_excel_by.python (49 lines) ----------
# Load the Python Standard and DesignScript Libraries
import sys
import os
#sys.path.append(r'C:\Users\HEC\AppData\Local\Programs\Python\Python39\Lib\site-packages')
#sys.path.append(r'C:\Users\pjmk0\AppData\Local\Programs\Python\Python39\Lib\site-packages')
sys.path.append(os.getenv('LOCALAPPDATA').replace('\\','\\\\') + r'\Programs\Python\Python39\Lib\site-packages')
import clr
clr.AddReference('ProtoGeometry')
from Autodesk.DesignScript.Geometry import *
from collections import Iterable

def iterable(obj):
    return isinstance(obj, Iterable)


# The inputs to this node will be stored as a list in the IN variables.
dataEnteringNode = IN
PathIn = IN[0]

# Place your code below this line
import datetime
import openpyxl

path = (PathIn)
#path = (r'C:\Users\pjmk0\Downloads\MK\mQ\BIM_물량집계 자동화 산출기준표_rC(20210607)_mk_de.xlsx')

wb_obj = openpyxl.load_workbook(path, data_only=True)
sheet_obj = wb_obj.active

m_row = sheet_obj.max_row
m_col = sheet_obj.max_column

listOut = []



for i in range(1, m_row +1):
    listTemp = []
    for j in range(1, m_col + 1):
        cell_obj = sheet_obj.cell(row=i, column=j)
        listTemp.append(cell_obj.value)
        if len(listTemp) == m_col:
            listOut.append(listTemp)
        


# Assign your output to the OUT variable.
OUT = listOut
#OUT = os.getenv('APPDATA')
# ----------------------------------------
code_block_2 = CodeBlock { "Scope_lv2(Walls)"; }
code_block_3 = CodeBlock { false; }
importExcel = Data.ImportExcel(file=file_from_path, sheetName=code_block_2, showExcel=code_block_3)  # frozen

# group: Null값 처리
code_block_4 = CodeBlock { " "; }
isNull = Object.IsNull()  # unwired: object
replaceByCondition = Replace(item=python_script_import_excel_by, replaceWith=code_block_4, condition=isNull)

# group: Whole Data(Column direction)
transpose = List.Transpose(lists=replaceByCondition)
watch = Watch(transpose)

# group: Whole Data(row direction)
watch_2 = Watch(replaceByCondition)

# group: Column Index Guide
code_block_5 = CodeBlock(i=watch_2) { i[3]; }
watch_3 = Watch(code_block_5)

# group: 모델링에 사용된 모든 패밀리타입 코드 추출
elementType = Element.ElementType(element=all_elements_of_category)
name_2 = Element.Name(element=elementType)
uniqueItems = List.UniqueItems(list=name_2@L2)
flatten = List.Flatten(list=uniqueItems)
watch_4 = Watch(flatten)
code_block_6 = CodeBlock { "_"; }
split_2 = String.Split(str=watch_4, separator0=code_block_6)
firstItem_2 = List.FirstItem(list=split_2@L2)

# group: 사용된 패밀리타입이 위치한 Column Index 추출
string_from_object_2 = FromObject(obj=watch_3)
contains = String.Contains(searchFor=firstItem_2, lacing=CrossProduct)  # unwired: str
map = List.Map(list=string_from_object_2, f_x=contains)
allFalse = List.AllFalse(list=map@L2)
code_block_7 = CodeBlock(i=allFalse) { i==false?true:false; }
code_block_8 = CodeBlock { true; }
allIndicesOf = List.AllIndicesOf(list=code_block_7, item=code_block_8)

# group: 사용된 패밀리타입 Column Data 추출
watch_5 = Watch(allIndicesOf)
getItemAtIndex = List.GetItemAtIndex(list=watch, index=watch_5)
code_block_9 = CodeBlock { 4; ""; }
# note: 불필요 정보 처리
replaceItemAtIndex = List.ReplaceItemAtIndex(list=getItemAtIndex@L2, index=code_block_9.out0, item=code_block_9.out1)
watch_6 = Watch(getItemAtIndex)

identity = Object.Identity(object=watch_2)

# group: 사용된 패밀리 타입에서 세부코드가 기입된 Row 열 번호 추출
string_from_object_3 = FromObject(obj=replaceItemAtIndex)
code_block_10 = CodeBlock { "000"; }
contains_2 = String.Contains(str=string_from_object_3@L2, searchFor=code_block_10, lacing=CrossProduct)
code_block_11 = CodeBlock { true; }
allIndicesOf_2 = List.AllIndicesOf(list=contains_2@L2, item=code_block_11)
watch_7 = Watch(allIndicesOf_2)

# group: WM code 추출
watch_8 = Watch(replaceItemAtIndex)
identity_2 = Object.Identity(object=identity)
getItemAtIndex_2 = List.GetItemAtIndex(list=identity_2, index=watch_7@L2)
watch_9 = Watch(getItemAtIndex_2)
code_block_12 = CodeBlock { 0; }
getItemAtIndex_3 = List.GetItemAtIndex(list=watch_9@@L2, index=code_block_12)
watch_10 = Watch(getItemAtIndex_3)
getItemAtIndex_4 = List.GetItemAtIndex(list=watch_8@L2, index=watch_7@L2)
watch_11 = Watch(getItemAtIndex_4)
code_block_13 = CodeBlock(i=watch_10, j=watch_11) { i + "-" + j; }
code_block_14 = CodeBlock(i=identity_2) { i[3]; }
watch_12 = Watch(code_block_14)
code_block_15 = CodeBlock { 2; }
getItemAtIndex_5 = List.GetItemAtIndex(list=watch_9@@L2, index=code_block_15)
watch_13 = Watch(getItemAtIndex_5)
code_block_16 = CodeBlock { 3; }
getItemAtIndex_6 = List.GetItemAtIndex(list=watch_9@@L2, index=code_block_16)
watch_14 = Watch(getItemAtIndex_6)
code_block_17 = CodeBlock { 4; }
getItemAtIndex_7 = List.GetItemAtIndex(list=watch_9@@L2, index=code_block_17)
watch_15 = Watch(getItemAtIndex_7)

# group: Wall Type: WM Code 딕셔너리 생성(벽체 layer에 포함 되지 않은 WM code 까지 포함되어야함)
code_block_18 = CodeBlock { 3; }
getItemAtIndex_8 = List.GetItemAtIndex(list=watch_8@L2, index=code_block_18)
code_block_19 = CodeBlock { "_"; "-"; }
split_3 = String.Split(str=getItemAtIndex_8, separator0=code_block_19.out0, separator1=code_block_19.out1)
firstItem_3 = List.FirstItem(list=split_3@L2)
byKeysValues = DesignScript.Builtin.Dictionary.ByKeysValues(keys=firstItem_3, values=code_block_13)
watch_16 = Watch(byKeysValues)

# group: material inform from excel sheet <per family type>
watch_17 = Watch(watch_16)

# group: D. Family Type
elementType_2 = Element.ElementType(element=all_elements_of_category)
name_3 = Element.Name(element=elementType_2)

# group: material inform from excel sheet <per element>
keys = DesignScript.Builtin.Dictionary.Keys(dictionary=watch_17)
name_4 = Element.Name(element=elementType_2)
contains_3 = String.Contains(str=name_4, searchFor=keys, lacing=CrossProduct)
code_block_20 = CodeBlock { true; }
allIndicesOf_3 = List.AllIndicesOf(list=contains_3@L2, item=code_block_20)
flatten_2 = List.Flatten(list=allIndicesOf_3)
getItemAtIndex_9 = List.GetItemAtIndex(list=keys, index=flatten_2)
valueAtKey = DesignScript.Builtin.Dictionary.ValueAtKey(dictionary=watch_17, key=getItemAtIndex_9)

# group: 합집합
add = _ + _  # unwired: x, y
code_block_21 = CodeBlock { "..."; }
add_2 = chop@L2 + code_block_21
combine = List.Combine(combineFunction=add, list0=add_2, list1=valueAtKey)
isNull_2 = Object.IsNull(object=combine)
anyTrue = List.AnyTrue(list=isNull_2@L2)
code_block_22 = CodeBlock { true; }
allIndicesOf_4 = List.AllIndicesOf(list=anyTrue, item=code_block_22)
removeItemAtIndex = List.RemoveItemAtIndex(list=combine, indices=allIndicesOf_4)
code_block_23 = CodeBlock { "..."; }
split_4 = String.Split(str=removeItemAtIndex, separator0=code_block_23)
code_block_24 = CodeBlock { 1; }
flatten_3 = List.Flatten(list=split_4@L3, amt=code_block_24)

# group: WM 중복제거
uniqueItems_2 = List.UniqueItems(list=flatten_3@L2)

# group: WM 중복제거
watch_wm_중복제거 = Watch(uniqueItems_2)

# group: element-wm 별 면적(m2) 물량 추출 구간
code_block_25 = CodeBlock { "Area"; }
getParameterValueByName = Element.GetParameterValueByName(element=watch_all_elements_of_category_2, parameterName=code_block_25)
flatten_4 = List.Flatten(list=getParameterValueByName)
watch_18 = Watch(flatten_4)
count_2 = List.Count(list=watch_wm_중복제거@@L2)
ofRepeatedItem = List.OfRepeatedItem(item=watch_18, amount=count_2@@L1, lacing=Shortest)
flatten_5 = List.Flatten(list=ofRepeatedItem)

watch_19 = Watch(flatten_5)
watch_20 = Watch(watch_wm_중복제거)
flatten_6 = List.Flatten(list=watch_20)

# group: input list 에서 대상문자열들 포함하는 index 추출(for skirt)
대상_문자열 = CodeBlock()
# ---------- 대상_문자열.designscript (5 lines) ----------
[

"A04AL081"//Skirt

];
# ----------------------------------------
code_block_26 = CodeBlock(str=flatten_6, searchFor=대상_문자열) { String.Contains(str<1>, searchFor, false); }
allFalse_2 = List.AllFalse(list=code_block_26@L2)
code_block_27 = CodeBlock { false; }
allIndicesOf_5 = List.AllIndicesOf(list=allFalse_2, item=code_block_27)

# group: element-wm 별 길이(m) 물량 추출 구간
code_block_28 = CodeBlock { "Length"; }
getParameterValueByName_2 = Element.GetParameterValueByName(element=watch_all_elements_of_category_2, parameterName=code_block_28)
flatten_7 = List.Flatten(list=getParameterValueByName_2)
watch_21 = Watch(flatten_7)
count_3 = List.Count(list=watch_wm_중복제거@@L2)
ofRepeatedItem_2 = List.OfRepeatedItem(item=watch_21, amount=count_3, lacing=Shortest)
flatten_8 = List.Flatten(list=ofRepeatedItem_2)

code_block_29 = CodeBlock(i=flatten_8) { i / 1000; }
watch_22 = Watch(code_block_29)

# group: element-wm 별 적합 물량 매칭 구간 (unit:m2 base, unit:m modify)
watch_23 = Watch(flatten_5)
watch_24 = Watch(allIndicesOf_5)
getItemAtIndex_10 = List.GetItemAtIndex(list=watch_22, index=allIndicesOf_5)
watch_25 = Watch(getItemAtIndex_10)
code_block_30 = CodeBlock(inList=watch_23, replaceIndex=watch_24, replaceValue=watch_25)
# ---------- code_block_30.designscript (6 lines) ----------
numIndex = 0..List.Count(inList)-1;
numIndexDiffer = List.SetDifference(numIndex,replaceIndex);
numIndexFlatten = List.Flatten([numIndexDiffer,replaceIndex],-1);
bln1 = List.Contains(replaceIndex,numIndex<1>);
outList = List.FilterByBoolMask(inList,bln1);
outListFlatten = List.Flatten([outList["out"],replaceValue],-1);
# ----------------------------------------
watch_26 = Watch(code_block_30.bln1)
watch_27 = Watch(code_block_30.outList)
sortByKey = List.SortByKey(list=code_block_30.outListFlatten, keys=code_block_30.numIndexFlatten)
watch_28 = Watch(sortByKey.sortedList)

# group: element 별 위치정보 삽입 구간
code_block_31 = CodeBlock {  }
code_block_32 = CodeBlock {  }

watch_29 = Watch(firstItem_2)

# group: Family Type 별 sorting
elementType_3 = Element.ElementType()  # unwired: element
uniqueItems_3 = List.UniqueItems(list=elementType_3)
groupByFunction = List.GroupByFunction(list=all_elements_of_category@L2, groupFunction=uniqueItems_3)

byKeysValues_2 = DesignScript.Builtin.Dictionary.ByKeysValues(keys=watch_29, values=groupByFunction@L3)
components = DesignScript.Builtin.Dictionary.Components(dictionary=byKeysValues_2)

# group: select all Category element by level
code_block_33 = CodeBlock { "Base Constraint"; }
getParameterValueByName_3 = Element.GetParameterValueByName(parameterName=code_block_33)  # unwired: element
groupByFunction_2 = List.GroupByFunction(list=components.values@L2, groupFunction=getParameterValueByName_3)

byKeysValues_3 = DesignScript.Builtin.Dictionary.ByKeysValues(keys=components.keys, values=components.values@L3)
count_4 = List.Count(list=ofRepeatedItem_2@L2)
sublists = List.Sublists(list=code_block_29, ranges=count_4)  # unwired: offset

# group: Row Index Guide
code_block_34 = CodeBlock(i=watch) { i[3]; }
watch_30 = Watch(code_block_34)

# group: grid개체
categories_2 = Categories("OST_Grids")
all_elements_of_category_2 = ElementsOfCategory(Category=categories_2)
parameters = Element.Parameters(element=all_elements_of_category_2)
name_5 = Element.Name(element=all_elements_of_category_2)
geometry = Element.Geometry(element=all_elements_of_category_2)

code_block_35 = CodeBlock {  }
code_block_36 = CodeBlock {  }

# group: C. Category
code_block_37 = CodeBlock { "Category"; }
getParameterValueByName_4 = Element.GetParameterValueByName(element=all_elements_of_category, parameterName=code_block_37)

parameters_2 = Element.Parameters(element=all_elements_of_category)

# group: input list 에서 대상문자열들 포함하는 index 추출(for concrete)
대상_문자열_2 = CodeBlock()
# ---------- 대상_문자열_2.designscript (5 lines) ----------
[

"A03AD032"//Concrete

];
# ----------------------------------------
code_block_38 = CodeBlock(str=flatten_6, searchFor=대상_문자열_2) { String.Contains(str<1>, searchFor, false); }
allFalse_3 = List.AllFalse(list=code_block_38@L2)
code_block_39 = CodeBlock { false; }
allIndicesOf_6 = List.AllIndicesOf(list=allFalse_3, item=code_block_39)

# group: element-wm 별 체적(m3) 물량 추출 구간
code_block_40 = CodeBlock { "Volume"; }
getParameterValueByName_5 = Element.GetParameterValueByName(element=watch_all_elements_of_category_2, parameterName=code_block_40)
flatten_9 = List.Flatten(list=getParameterValueByName_5)
watch_31 = Watch(flatten_9)
count_5 = List.Count(list=watch_wm_중복제거@@L2)
ofRepeatedItem_3 = List.OfRepeatedItem(item=watch_31, amount=count_5@@L1, lacing=Shortest)
flatten_10 = List.Flatten(list=ofRepeatedItem_3)

# group: element-wm 별 적합 물량 매칭 구간 (unit:m2 base, unit:m modify)
watch_32 = Watch(watch_28)
watch_33 = Watch(allIndicesOf_6)
getItemAtIndex_11 = List.GetItemAtIndex(list=flatten_10, index=allIndicesOf_6)
watch_34 = Watch(getItemAtIndex_11)
code_block_41 = CodeBlock(inList=watch_32, replaceIndex=watch_33, replaceValue=watch_34)  # same code as code_block_30
sortByKey_2 = List.SortByKey(list=code_block_41.outListFlatten, keys=code_block_41.numIndexFlatten)
watch_35 = Watch(sortByKey_2.sortedList)
watch_36 = Watch(code_block_41.bln1)
watch_37 = Watch(code_block_41.outList)

# group: input list 에서 대상문자열들 포함하는 index 추출(for forms)
대상_문자열_3 = CodeBlock()
# ---------- 대상_문자열_3.designscript (7 lines) ----------
[

"A03AD036",//Form
"A04AS164"//Plastering


];
# ----------------------------------------
code_block_42 = CodeBlock(str=flatten_6, searchFor=대상_문자열_3) { String.Contains(str<1>, searchFor, false); }
allFalse_4 = List.AllFalse(list=code_block_42@L2)
code_block_43 = CodeBlock { false; }
allIndicesOf_7 = List.AllIndicesOf(list=allFalse_4, item=code_block_43)

element_wm_별_면적_형상 = CodeBlock(i=flatten_5) { i; }

# group: element-wm 별 적합 물량 매칭 구간(벽체 양쪽 적용 WM Code modify)-form, plaster
watch_38 = Watch(watch_35)
watch_39 = Watch(allIndicesOf_7)
getItemAtIndex_12 = List.GetItemAtIndex(list=element_wm_별_면적_형상, index=allIndicesOf_7)

form_물량_보정 = CodeBlock(i=getItemAtIndex_12) { i * 2; }

# group (continued): element-wm 별 적합 물량 매칭 구간(벽체 양쪽 적용 WM Code modify)-form, plaster
watch_40 = Watch(form_물량_보정)
code_block_44 = CodeBlock(inList=watch_38, replaceIndex=watch_39, replaceValue=watch_40)  # same code as code_block_30
sortByKey_3 = List.SortByKey(list=code_block_44.outListFlatten, keys=code_block_44.numIndexFlatten)
watch_41 = Watch(sortByKey_3.sortedList)

# group: element 별 WorkMaster, Family Type 삽입 구간
identity_3 = Object.Identity(object=watch_all_elements_of_category_2)
identity_4 = Object.Identity(object=identity_3)
identity_5 = Object.Identity(object=identity_4)
elementType_4 = Element.ElementType(element=identity_5@L1)
name_6 = Element.Name(element=elementType_4)
count_6 = List.Count(list=watch_wm_중복제거@L2)
identity_6 = Object.Identity(object=count_6)
ofRepeatedItem_4 = List.OfRepeatedItem(item=name_6, amount=identity_6, lacing=Shortest)
watch_42 = Watch(ofRepeatedItem_4)
flatten_11 = List.Flatten(list=watch_42)
watch_43 = Watch(watch_41)
code_block_45 = CodeBlock(i=flatten_11, j=watch_43) { i + "..." + j; }
watch_44 = Watch(code_block_45)
identity_7 = Object.Identity(object=flatten_6)
identity_8 = Object.Identity(object=identity_7)
watch_45 = Watch(identity_8)
code_block_46 = CodeBlock(i=watch_44, j=watch_45) { i + "..." + j; }
watch_46 = Watch(code_block_46)

# group: Data arrange for excel
flatten_12 = List.Flatten(list=watch_46)
code_block_47 = CodeBlock { "..."; }
split_5 = String.Split(str=flatten_12, separator0=code_block_47)
watch_47 = Watch(split_5)

# group: Export Excel(By OpenpyXl)
python_script_export_excel_by = Python(IN[0]=watch_47)  # "Python Script@Export Excel(By OpenpyXl)"; CPython3; frozen
# ---------- python_script_export_excel_by.python (152 lines) ----------
# Load the Python Standard and DesignScript Libraries
import sys
import os
#sys.path.append(r'C:\Users\HEC\AppData\Local\Programs\Python\Python39\Lib\site-packages')
#sys.path.append(r'C:\Users\pjmk0\AppData\Local\Programs\Python\Python39\Lib\site-packages')
sys.path.append(os.getenv('LOCALAPPDATA').replace('\\','\\\\') + r'\Programs\Python\Python39\Lib\site-packages')
import clr
clr.AddReference('ProtoGeometry')
from Autodesk.DesignScript.Geometry import *
from collections import Iterable

def iterable(obj):
    return isinstance(obj, Iterable)


# The inputs to this node will be stored as a list in the IN variables.
dataEnteringNode = IN
ListIn = IN[0]

# Place your code below this line
import datetime
from datetime import date, timedelta
Today = date.today()
import openpyxl
from openpyxl.styles import Border, Side, PatternFill, Font, GradientFill, Alignment, Color, numbers

sample_items = ListIn


def write_to_file(filepath):
    wb = openpyxl.Workbook()
    for sheet in wb.sheetnames:
        wb.remove(wb[sheet])

    thin = Side(border_style="thin", color="000000")
    double = Side(border_style="double", color="000000")

    ws = wb.create_sheet(title='Wall_Calc_instance', index=0)

    ws.merge_cells('A1:L1')
    ws['A1'] = 'HEC Wall Category Calculation Sheet'
    cell = ws['A1']
    cell.font = openpyxl.styles.Font(color='000000', size=20)
    cell.fill = openpyxl.styles.fills.PatternFill(patternType='solid',
                                                  fgColor=openpyxl.styles.colors.Color(rgb='fff3b0'))

    ws['A2'] = 'Item Number'
    ws['A2'].font = openpyxl.styles.Font(b=True, color='000000', size=12)
    #ws['B2'] = 'Member Name'
    #ws['B2'].font = openpyxl.styles.Font(b=True, color='000000', size=12)
    #ws['C2'] = 'Category'
    #ws['C2'].font = openpyxl.styles.Font(b=True, color='000000', size=12)
    ws['B2'] = 'Family Type'
    ws['B2'].font = openpyxl.styles.Font(b=True, color='000000', size=12)
    ws['D2'] = 'WorkMaster Code'
    ws['D2'].font = openpyxl.styles.Font(b=True, color='000000', size=12)
    #ws['F2'] = 'WorkMaster Description'
    #ws['F2'].font = openpyxl.styles.Font(b=True, color='000000', size=12)
    #ws['G2'] = 'Unit'
    #ws['G2'].font = openpyxl.styles.Font(b=True, color='000000', size=12)
    #ws['H2'] = '계수'
    #ws['H2'].font = openpyxl.styles.Font(b=True, color='000000', size=12)
    #ws['I2'] = '계산 참조값'
    #ws['I2'].font = openpyxl.styles.Font(b=True, color='000000', size=12)
    ws['C2'] = 'Quantities'
    ws['C2'].font = openpyxl.styles.Font(b=True, color='000000', size=12)
    ws['E2'] = 'Unit Price'
    ws['E2'].font = openpyxl.styles.Font(b=True, color='000000', size=12)
    ws['F2'] = 'Total Price'
    ws['F2'].font = openpyxl.styles.Font(b=True, color='000000', size=12)


## 칼럼별 너비 조정 구간
#    for col in range(ws.max_column):
#        ws.column_dimensions[chr(ord('A') + col)].width = 15
    ws.column_dimensions['A'].width = 15
    ws.column_dimensions['B'].width = 45
    ws.column_dimensions['C'].width = 12
    ws.column_dimensions['D'].width = 20
    ws.column_dimensions['E'].width = 20
    ws.column_dimensions['F'].width = 20
    #ws.column_dimensions['G'].width = 9
    #ws.column_dimensions['H'].width = 9
    #ws.column_dimensions['H'].hidden = True
    #ws.column_dimensions['I'].width = 12
    #ws.column_dimensions['I'].hidden = True
    #ws.column_dimensions['J'].width = 12
    #ws.column_dimensions['K'].width = 12
    #ws.column_dimensions['L'].width = 12

###
    start_row = 3
    for (row, item) in enumerate(sample_items, start_row):
        cell = ws.cell(row=row, column=1, value=row - 2)
        cell.alignment = openpyxl.styles.Alignment(horizontal='center', vertical='center')

#        cell = ws.cell(row=row, column=2, value=item[0])
#        cell.number_format = openpyxl.styles.numbers.FORMAT_DATE_YYYYMMDD2  # 'yyyy-mm-dd'
        ws.cell(row=row, column=2, value=item[0]) ## Room Name 칼럼

        ws.cell(row=row, column=3, value=item[1]) ## Department 칼럼
        
        ws.cell(row=row, column=4, value=item[2]) ## Interior Finish Type 칼럼
        
        #ws.cell(row=row, column=5, value=item[3]) ## WorkMaster Code 칼럼
        
        #ws.cell(row=row, column=6, value=item[4]) ## WorkMaster Description 칼럼
        
        #ws.cell(row=row, column=7, value=item[5]) ## Unit 칼럼

        #cell = ws.cell(row=row, column=8, value=item[6]) ## 계수 칼럼
        #cell.number_format = openpyxl.styles.numbers.builtin_format_code(3)  # '#,##0'
        
        #cell = ws.cell(row=row, column=9, value=item[7]) ## 계산 참조값 칼럼
        #cell.number_format = openpyxl.styles.numbers.builtin_format_code(3)  # '#,##0'
        
        #cell = ws.cell(row=row, column=10, value=item[8]) ## Quantities 칼럼
        #cell.number_format = openpyxl.styles.numbers.builtin_format_code(3)  # '#,##0'
        #cell.font = openpyxl.styles.Font(b=True, color='000000', size=11)

        cell = ws.cell(row=row, column=6, value='= C{current_row}*E{current_row}'.format(current_row=cell.row))
        cell.number_format = '#,##0'

#        cell = ws.cell(row=row, column=6, value='= D{current_row} * E{current_row}'.format(current_row=cell.row))
#        cell.number_format = openpyxl.styles.numbers.builtin_format_code(3)

    total_row = ws.max_row + 1
    if total_row > start_row:
        cell1 = ws.cell(row=total_row, column=5, value='Total')
        cell1.font = openpyxl.styles.Font(b=True, color='000000', size=15)
        
        cell2 = ws.cell(row=total_row, column=6, value='= SUM(F{}:F{})'.format(start_row, total_row - 1))
        cell2.number_format = openpyxl.styles.numbers.builtin_format_code(3)
        cell2.border = Border(top=double, left=double, right=double, bottom=double)
        cell2.font = openpyxl.styles.Font(b=True, color='ff03ce', size=15)
    

    wb.save(filepath)
    wb.close()


##if __name__ == '__main__':
#write_to_file('C:\\Users\\pjmk0\\AppData\\Roaming\\test.xlsx')

save_name = "HecWallCalcSheet1_" + Today.strftime("%Y-%m-%d")+".xlsx"
path = os.getenv('APPDATA').replace('\\','\\\\')
filePath = path + '\\' + save_name

write_to_file(filePath)

# Assign your output to the OUT variable.
OUT = os.getenv('APPDATA')
# ----------------------------------------

watch_48 = Watch(all_elements_of_category)

# group: 인덱스-엘리먼트, 인덱스-WM code 딕셔너리 형성
count_7 = List.Count(list=watch_48)
code_block_48 = CodeBlock(j=count_7) { 0..(j-1); }
string_from_object_4 = FromObject(object=code_block_48)
byKeysValues_4 = DesignScript.Builtin.Dictionary.ByKeysValues(keys=string_from_object_4, values=watch_48)
watch_49 = Watch(byKeysValues_4)
byKeysValues_5 = DesignScript.Builtin.Dictionary.ByKeysValues(keys=string_from_object_4, values=uniqueItems_2)
watch_50 = Watch(byKeysValues_5)

watch_51 = Watch(name_3)
byKeysValues_6 = DesignScript.Builtin.Dictionary.ByKeysValues(keys=string_from_object_4, values=watch_51)
watch_52 = Watch(byKeysValues_6)
valueAtKey_2 = DesignScript.Builtin.Dictionary.ValueAtKey(dictionary=watch_52, key=string_from_object_4)
code_block_49 = CodeBlock {  }
code_block_50 = CodeBlock {  }

# group: Test 구간
code_block_51 = CodeBlock {  }
code_block_52 = CodeBlock {  }

getMaterials_2 = Element.GetMaterials(element=all_elements_of_category)
parameters_3 = Element.Parameters(element=getMaterials_2)
code_block_53 = CodeBlock { "d8450ee6-31bf-3463-a189-4fd1ad506668"; }
findByGuid = archilab.Revit.Elements.Schema.FindByGuid(guid=code_block_53)
valueAtKey_3 = DesignScript.Builtin.Dictionary.ValueAtKey(dictionary=watch_49, key=string_from_object_4)
parameters_4 = Element.Parameters(element=valueAtKey_3)
valueAtKey_4 = DesignScript.Builtin.Dictionary.ValueAtKey(dictionary=watch_50, key=string_from_object_4)

# group: 산출값 List 초기화
code_block_54 = CodeBlock { "initialValue"; }
count_8 = List.Count(list=valueAtKey_4@L2)
ofRepeatedItem_5 = List.OfRepeatedItem(item=code_block_54, amount=count_8)

# group: 산출대상 WM 인덱스 넘버 추출
code_block_55 = CodeBlock { "A03AD032-00007"; }
# note: element 인덱스
allIndicesOf_8 = List.AllIndicesOf(list=valueAtKey_4@L2, item=code_block_55)
contains_4 = List.Contains(list=valueAtKey_4@L2, item=code_block_55)
code_block_56 = CodeBlock { true; }
# note: element 별 WM 인덱스
allIndicesOf_9 = List.AllIndicesOf(list=contains_4, item=code_block_56)

# group: Volume 값 추출
code_block_57 = CodeBlock { "Volume"; }
getParameterValueByName_6 = Element.GetParameterValueByName(element=valueAtKey_3, parameterName=code_block_57)
getItemAtIndex_13 = List.GetItemAtIndex(list=getParameterValueByName_6, index=allIndicesOf_9)
code_block_58 = CodeBlock { 2; }
round = Math.Round(number=getItemAtIndex_13, digits=code_block_58)

replaceItemAtIndex_2 = List.ReplaceItemAtIndex(list=ofRepeatedItem_5@L2, index=allIndicesOf_8, item=round, lacing=Longest)
isEmpty = List.IsEmpty(list=replaceItemAtIndex_2@L3)
code_block_59 = CodeBlock { true; }
allIndicesOf_10 = List.AllIndicesOf(list=isEmpty, item=code_block_59)
getItemAtIndex_14 = List.GetItemAtIndex(list=ofRepeatedItem_5, index=allIndicesOf_10)
code_block_60 = CodeBlock(i=getItemAtIndex_14) { i[0]; }
replaceItemAtIndex_3 = List.ReplaceItemAtIndex(list=replaceItemAtIndex_2@L4, index=allIndicesOf_10@L1, item=code_block_60, lacing=Shortest)
code_block_61 = CodeBlock { 1; }
flatten_13 = List.Flatten(list=replaceItemAtIndex_2@L3, amt=code_block_61)
code_block_62 = CodeBlock { 4; }
type = Object.Type(obj=watch_47)
count_9 = List.Count(list=valueAtKey_4@@L2)
code_block_63 = CodeBlock {  }
code_block_64 = CodeBlock { 2; 3; 5; }
mul = _ * code_block_64.out0  # unwired: x
mul_2 = _ * code_block_64.out1  # unwired: x
mul_3 = _ * code_block_64.out2  # unwired: x
join = List.Join(list0=mul, list1=mul_2, list2=mul_3)
code_block_65 = CodeBlock(i=join) { i[0]; i[1]; i[2]; }
function_compose = ComposeFunctions(function0=code_block_65.out0, function1=code_block_65.out1, function2=code_block_65.out2)
code_block_66 = CodeBlock { [2,3,5]; }
function_apply = ApplyFunction(function=join, argument0=code_block_66)
python_script = Python(IN[0]=join, IN[1]=code_block_66)  # CPython3
# ---------- python_script.python (34 lines) ----------
# Load the Python Standard and DesignScript Libraries
import sys
import clr
clr.AddReference('ProtoGeometry')
from Autodesk.DesignScript.Geometry import *

# The inputs to this node will be stored as a list in the IN variables.
dataEnteringNode = IN


# Place your code below this line

def a(input):
    return input * 2
    
def b(input):
    return input * 3

def c(input):
    return input * 5

#funcList = IN[0]
numList = IN[1]
funcList = [a, b, c]
#numList = [2, 3, 5]

listOut = []
for i in range(len(numList)):
    listOut.append(funcList[i](numList[i]))
    


# Assign your output to the OUT variable.
OUT = listOut
# ----------------------------------------
