# Dynamo graph bolt test.dyn (Dynamo 2.12.0.5650)

python_script = Python()  # CPython3; unwired: IN[0]
# ---------- python_script.python (25 lines) ----------
# Load the Python Standard and DesignScript Libraries
import sys
import clr
clr.AddReference('ProtoGeometry')
from Autodesk.DesignScript.Geometry import *

clr.AddReference('RevitAPI')
from Autodesk.Revit.DB import *
import Autodesk

clr.AddReference('RevitServices')
import RevitServices
from RevitServices.Persistence import DocumentManager
doc = DocumentManager.Instance.CurrentDBDocument
collector = FilteredElementCollector(doc)

allElems = collector.OfCategory(BuiltInCategory.OST_StructuralFoundation).WhereElementIsNotElementType().ToElements()

# The inputs to this node will be stored as a list in the IN variables.
dataEnteringNode = IN

# Place your code below this line

# Assign your output to the OUT variable.
OUT = allElems
# ----------------------------------------
python_script_2 = Python()  # CPython3; unwired: IN[0]
# ---------- python_script_2.python (25 lines) ----------
# Load the Python Standard and DesignScript Libraries
import sys
import clr
clr.AddReference('ProtoGeometry')
from Autodesk.DesignScript.Geometry import *

clr.AddReference('RevitAPI')
from Autodesk.Revit.DB import *
import Autodesk

clr.AddReference('RevitServices')
import RevitServices
from RevitServices.Persistence import DocumentManager
doc = DocumentManager.Instance.CurrentDBDocument
collector = FilteredElementCollector(doc)

allElems = collector.OfCategory(BuiltInCategory.OST_StructConnectionAnchors).WhereElementIsNotElementType().ToElements()

# The inputs to this node will be stored as a list in the IN variables.
dataEnteringNode = IN

# Place your code below this line

# Assign your output to the OUT variable.
OUT = allElems
# ----------------------------------------
python_script_3 = Python()  # CPython3; unwired: IN[0]
# ---------- python_script_3.python (57 lines) ----------
# Load the Python Standard and DesignScript Libraries
import clr
import os
import webbrowser
import unicodedata

clr.AddReference('RevitAPISteel')
clr.AddReference('RevitAPI')
from Autodesk.Revit.DB import *
import Autodesk

clr.AddReference('RevitAPIUI')
from Autodesk.Revit.UI import Selection

clr.AddReference('RevitNodes')
import Revit
clr.ImportExtensions(Revit.Elements)
clr.ImportExtensions(Revit.GeometryConversion)

clr.AddReference('RevitServices')
from RevitServices.Persistence import DocumentManager
from RevitServices.Transactions import TransactionManager
doc = DocumentManager.Instance.CurrentDBDocument

clr.AddReference('DSCoreNodes')
from DSCore import *

clr.AddReference('ProtoGeometry')
from Autodesk.DesignScript.Geometry import *

collector = FilteredElementCollector(doc)

connection = collector.OfCategory(BuiltInCategory.OST_StructConnections).ToElements()[4]
allElems = collector.OfCategory(BuiltInCategory.OST_StructConnections).ToElements()#.WhereElementIsNotElementType().ToElements()

# The inputs to this node will be stored as a list in the IN variables.
dataEnteringNode = IN

# Place your code below this line
TransactionManager.Instance.EnsureInTransaction(doc)
opt = Autodesk.Revit.DB.Options()
opt.ComputeReferences = True
opt.IncludeNonVisibleObjects = True
opt.View = doc.ActiveView
geo = connection.get_Geometry(opt)#.GetInstanceGeometry()
geo2 = []
for i in geo:
    geo2.append(i.GetInstanceGeometry())
result = geo2[0]
result2=[]
for i in result:
    result2.append(i.ToProtoType())
    

TransactionManager.Instance.TransactionTaskDone()
# Assign your output to the OUT variable.
OUT = result2
# ----------------------------------------
string_from_object = FromObject(object=python_script_3)
code_block = CodeBlock(i=string_from_object) { i=="Solid"; }
filterByBoolMask = List.FilterByBoolMask(list=python_script_3, mask=code_block)
code_block_2 = CodeBlock(i=filterByBoolMask.in) { i[0]; }
explode = Geometry.Explode(geometry=code_block_2)
code_block_3 = CodeBlock(i=explode) { i[9]; }
perimeterCurves = Surface.PerimeterCurves(surface=code_block_3)
