# Dynamo graph leanTest_아래로 움직여빼기.dyn (Dynamo 2.12.0.5650)

categories = Categories("OST_StructuralFoundation")
all_elements_of_category = ElementsOfCategory(Category=categories)
code_block = CodeBlock(i=all_elements_of_category) { i[173]; }
geometry = Element.Geometry(element=code_block)
code_block_2 = CodeBlock(i=all_elements_of_category) { i[174]; }
geometry_2 = Element.Geometry(element=code_block_2)
join = List.Join(list0=geometry, list1=geometry_2)
byUnion = Solid.ByUnion(solids=join)
code_block_3 = CodeBlock { -100; }
translate = Geometry.Translate(geometry=byUnion, zTranslation=code_block_3)
differenceAll = Solid.DifferenceAll(solid=translate, others=byUnion)
