# Dynamo graph Stair Calculator_HEC(0625).dyn "Stair Calculator(0625)" (Dynamo 2.10.1.3976)

# group: Stair
code_block = CodeBlock {  }
code_block_2 = CodeBlock {  }

# group: select all Category element
categories = Categories("OST_Stairs")
all_elements_of_category = ElementsOfCategory(Category=categories)
code_block_3 = CodeBlock { "Run Type"; }

elementType = Element.ElementType(element=all_elements_of_category)

# group (continued): select all Category element
parameterByName = Parameter.ParameterByName(element=elementType, name=code_block_3)
string_from_object = FromObject(object=parameterByName)
uniqueItems = List.UniqueItems(list=string_from_object)
code_block_4 = CodeBlock(i=string_from_object, j=uniqueItems) { i == j[0]; }
filterByBoolMask = List.FilterByBoolMask(list=all_elements_of_category, mask=code_block_4)

name = Element.Name(element=all_elements_of_category)
familyName = ElementType.FamilyName(elementType=elementType)
name_2 = Family.Name(family=all_elements_of_category)
getParameterValueByName = Element.GetParameterValueByName(element=elementType, parameterName=code_block_3)
watch = Watch(getParameterValueByName)
name_3 = Element.Name(element=watch)
watch_2 = Watch(name_3)
code_block_5 = CodeBlock { "콘크리트"; }
eq = watch_2 == code_block_5
filterByBoolMask_2 = List.FilterByBoolMask(list=all_elements_of_category, mask=eq)
콘크리 = Watch(filterByBoolMask_2.in)
geometry = Element.Geometry(element=콘크리)
watch_3 = Watch(geometry)
flatten = List.Flatten(list=watch_3)
explode = Geometry.Explode(geometry=flatten)
watch_4 = Watch(explode)
철골 = Watch(filterByBoolMask_2.out)
geometry_2 = Element.Geometry(element=철골)
watch_5 = Watch(geometry_2)
flatten_2 = List.Flatten(list=watch_5)
explode_2 = Geometry.Explode(geometry=flatten_2)
watch_6 = Watch(explode_2)
code_block_6 = CodeBlock(a=flatten_2) { a[2]; }
explode_3 = Geometry.Explode(geometry=code_block_6)
watch_7 = Watch(explode_3)
centroid = Solid.Centroid(solid=code_block_6)
boundingBox = Geometry.BoundingBox(geometry=code_block_6)
toCuboid = BoundingBox.ToCuboid(boundingBox=boundingBox)
code_block_7 = CodeBlock { 100; }
byARGB = Color.ByARGB(a=code_block_7, r=code_block_7)
byGeometryColor = Modifiers.GeometryColor.ByGeometryColor(geometry=toCuboid, color=byARGB)
minPoint = BoundingBox.MinPoint(boundingBox=boundingBox)
watch_8 = Watch(minPoint)
Y = Point.Y(point=watch_8)
Z = Point.Z(point=watch_8)
maxPoint = BoundingBox.MaxPoint(boundingBox=boundingBox)
watch_9 = Watch(maxPoint)
X = Point.X(point=watch_9)
X_2 = Point.X(point=watch_8)
Y_2 = Point.Y(point=watch_9)
Z_2 = Point.Z(point=watch_9)
byCoordinates = Point.ByCoordinates(x=X_2, y=Y_2, z=Z_2)
byStartPointEndPoint = Line.ByStartPointEndPoint(startPoint=watch_8, endPoint=byCoordinates)
explode_4 = Geometry.Explode(geometry=toCuboid)
pointAtParameter = Surface.PointAtParameter(surface=explode_4)
code_block_8 = CodeBlock { 1; }
pointAtParameter_2 = Surface.PointAtParameter(surface=explode_4, u=code_block_8, v=code_block_8)
byStartPointEndPoint_2 = Line.ByStartPointEndPoint(startPoint=pointAtParameter, endPoint=pointAtParameter_2)
length = Curve.Length()  # unwired: curve
maximumItemByKey = List.MaximumItemByKey(list=byStartPointEndPoint_2, keyFunction=length)
boundingBox_2 = Geometry.BoundingBox(geometry=flatten)
toCuboid_2 = BoundingBox.ToCuboid(boundingBox=boundingBox_2)
volume = Solid.Volume(solid=toCuboid_2)
watch_10 = Watch(volume)
code_block_9 = CodeBlock(a=watch_10) { a[0]; }
gt = watch_10 > code_block_9
filterByBoolMask_3 = List.FilterByBoolMask(list=toCuboid_2, mask=gt)
explode_5 = Geometry.Explode(geometry=filterByBoolMask_3.in)
pointAtParameter_3 = Surface.PointAtParameter(surface=explode_5)
code_block_10 = CodeBlock { 1; }
pointAtParameter_4 = Surface.PointAtParameter(surface=explode_5, u=code_block_10, v=code_block_10)
byStartPointEndPoint_3 = Line.ByStartPointEndPoint(startPoint=pointAtParameter_3, endPoint=pointAtParameter_4)
length_2 = Curve.Length()  # unwired: curve
maximumItemByKey_2 = List.MaximumItemByKey(list=byStartPointEndPoint_3@L2, keyFunction=length_2)
watch_11 = Watch(filterByBoolMask_3.out)
explode_6 = Geometry.Explode(geometry=watch_11)
flatten_3 = List.Flatten(list=explode_6)
area = Surface.Area()  # unwired: surface
maximumItemByKey_3 = List.MaximumItemByKey(list=flatten_3@L2, keyFunction=area)
perimeterCurves = Surface.PerimeterCurves(surface=maximumItemByKey_3)
flatten_4 = List.Flatten(list=perimeterCurves)
length_3 = Curve.Length()  # unwired: curve
minimumItemByKey = List.MinimumItemByKey(list=flatten_4, keyFunction=length_3)
code_block_11 = CodeBlock { 2; }
ofRepeatedItem = List.OfRepeatedItem(item=minimumItemByKey, amount=code_block_11)
maximumItemByKey_4 = List.MaximumItemByKey(list=flatten_4, keyFunction=length_3)
join = List.Join(list0=maximumItemByKey_2, list1=ofRepeatedItem, list2=maximumItemByKey_4)
watch_12 = Watch(join)
length_4 = Curve.Length(curve=watch_12)
sum = Math.Sum(values=length_4)

# group: Line 길이
code_block_12 = CodeBlock {  }
code_block_13 = CodeBlock {  }

# group: Line 길이
code_block_14 = CodeBlock {  }
code_block_15 = CodeBlock {  }

count = List.Count(list=geometry_2@L2)
code_block_16 = CodeBlock(a=count) { a>4; }
filterByBoolMask_4 = List.FilterByBoolMask(list=watch_5, mask=code_block_16)
watch_13 = Watch(filterByBoolMask_4.in)
flatten_5 = List.Flatten(list=watch_13)
explode_7 = Geometry.Explode(geometry=flatten_5)
flatten_6 = List.Flatten(list=explode_7)
code_block_17 = CodeBlock { 0.5; }
normalAtParameter = Surface.NormalAtParameter(surface=explode_7, u=code_block_17, v=code_block_17)
Z_3 = Vector.Z(vector=normalAtParameter)
code_block_18 = CodeBlock { 1; }
round = Math.Round(number=Z_3, digits=code_block_18)
flatten_7 = List.Flatten(list=round)
code_block_19 = CodeBlock(a=flatten_7) { a==0; }
filterByBoolMask_5 = List.FilterByBoolMask(list=flatten_6, mask=code_block_19)
flatten_8 = List.Flatten(list=filterByBoolMask_5.out)
