# Dynamo graph Str Column Calculator_HEC(0625).dyn "Str Column Calculator(0625)" (Dynamo 2.10.1.3976)

# group: 현재 카테고리 내에 적용될 Total WM code
file_path = Filename("..\dyn_test\wmCodeAll.xlsx")
file_from_path = FileObject()  # unwired: path
code_block = CodeBlock { "wmCodeAll"; }
code_block_2 = CodeBlock { false; }
importExcel = Data.ImportExcel(file=file_from_path, sheetName=code_block, showExcel=code_block_2)
transpose = List.Transpose(lists=importExcel)
count = List.Count(list=transpose)
file_path_2 = Filename(".\1.txt")
code_block_3 = CodeBlock { "..."; }
code_block_4 = CodeBlock { " "; }
isNull = Object.IsNull()  # unwired: object
replaceByCondition = Replace(item=transpose, replaceWith=code_block_4, condition=isNull)
code_block_5 = CodeBlock(i=replaceByCondition) { i[0]+"_"+i[1]+"_"+i[2]+"_"+i[3]; }
join = String.Join(separator=code_block_3, string0=code_block_5)
writeText = FileSystem.WriteText(filePath=file_path_2, text=join)
code_block_6 = CodeBlock(i=replaceByCondition) { i[0]; }
현재_카테고리_내에서_쓰일_total_wm_code = CodeBlock()
# ---------- 현재_카테고리_내에서_쓰일_total_wm_code.designscript (18 lines) ----------
i = [

"A03AC032",
"A03AC033",
"A03AC035",
"A03AC036",
"A03AC037",
"A03AE056",
"A03AE057",
"A03AE058",
"A03AE059",
"A03AE060",
"A03AE061",
"A03AH062",
"A03AH058",
"A03AH063"

];
# ----------------------------------------
indexOf = List.IndexOf(list=code_block_6, element=현재_카테고리_내에서_쓰일_total_wm_code)
getItemAtIndex = List.GetItemAtIndex(list=code_block_5, index=indexOf)  # frozen

# group: select all Category element
categories = Categories("OST_StructuralColumns")
all_elements_of_category = ElementsOfCategory()  # unwired: Category
code_block_7 = CodeBlock { "Base Level"; }
parameterByName = Parameter.ParameterByName(element=all_elements_of_category, name=code_block_7)
string_from_object = FromObject(object=parameterByName)
uniqueItems = List.UniqueItems(list=string_from_object)
code_block_8 = CodeBlock(i=string_from_object, j=uniqueItems) { i == j[0]; }
filterByBoolMask = List.FilterByBoolMask(list=all_elements_of_category, mask=code_block_8)

# group: 변수 확인 용
parameters = Element.Parameters(element=all_elements_of_category)
string_from_object_2 = FromObject(object=parameters)
code_block_9 = CodeBlock(i=string_from_object_2) { i[0][6]; }

code_block_10 = CodeBlock {  }

# group: Str Columns
code_block_11 = CodeBlock {  }
code_block_12 = CodeBlock {  }

geometry = Element.Geometry()  # unwired: element
watch = Watch(all_elements_of_category)
name = FamilyType.Name(familyType=watch)
watch_2 = Watch(name)
string_from_object_3 = FromObject(object=watch_2)
code_block_13 = CodeBlock { "H-"; }
contains = String.Contains(str=string_from_object_3, searchFor=code_block_13)
filterByBoolMask_2 = List.FilterByBoolMask(list=all_elements_of_category, mask=contains)
watch_3 = Watch(filterByBoolMask_2.out)
geometry_2 = Element.Geometry(element=watch_3)
code_block_14 = CodeBlock(i=watch_3) { i; }

# group: All solids
geometry_3 = Element.Geometry(element=code_block_14)

# group: Volume 검토
volume = Solid.Volume(solid=geometry_3)
watch_4 = Watch(volume)
code_block_15 = CodeBlock { "Volume"; }
getParameterValueByName = Element.GetParameterValueByName(element=code_block_14, parameterName=code_block_15)
watch_5 = Watch(getParameterValueByName)

# group: con'c ratio x
code_block_16 = CodeBlock(a=watch_5) { a*0.1; }
watch_6 = Watch(code_block_16)

# group: con'c ratio x
code_block_17 = CodeBlock { a*0.1; }  # unwired: a
watch_7 = Watch(code_block_17)

watch_8 = Watch(filterByBoolMask_2.in)
code_block_18 = CodeBlock(o=watch_8) { o; }

# group: All solids
geometry_4 = Element.Geometry(element=code_block_18)

elementType = Element.ElementType(element=code_block_18)

# group: Volume 검토
volume_2 = Solid.Volume(solid=geometry_4)
watch_9 = Watch(volume_2)
code_block_19 = CodeBlock { "Unit Weight"; }
getParameterValueByName_2 = Element.GetParameterValueByName(element=elementType, parameterName=code_block_19)
watch_10 = Watch(getParameterValueByName_2)

# group: 조금더 많은 element sample에서 test 30<a<90 관련 풀이 확인 후 적용
code_block_20 = CodeBlock(a=watch_10) { a>90; a<30; }
watch_11 = Watch(code_block_20.out1)
watch_12 = Watch(code_block_20.out0)
filterByBoolMask_3 = List.FilterByBoolMask(list=code_block_18, mask=watch_12)

# group: Base Plate 모델링 추가분 sample 에서 test
code_block_21 = CodeBlock {  }

현재_카테고리_내에서_쓰일_total_wm_full = CodeBlock(codeAll=getItemAtIndex) { codeAll; }  # "현재 카테고리 내에서 쓰일 Total WM full code"

# group: 거푸집 관련 WM 추출
현재_카테고리_내에서_쓰일_total_wm_code_2 = CodeBlock(codeAll=현재_카테고리_내에서_쓰일_total_wm_full) { codeAll; }
code_block_22 = CodeBlock()
# ---------- code_block_22.designscript (5 lines) ----------
[

"Form"

];
# ----------------------------------------
code_block_23 = CodeBlock(str=현재_카테고리_내에서_쓰일_total_wm_code_2, searchFor=code_block_22) { String.Contains(str<1>, searchFor, false); }
allFalse = List.AllFalse(list=code_block_23@L2)
code_block_24 = CodeBlock { false; }
allIndicesOf = List.AllIndicesOf(list=allFalse, item=code_block_24)
getItemAtIndex_2 = List.GetItemAtIndex(list=현재_카테고리_내에서_쓰일_total_wm_code_2, index=allIndicesOf)

# group: All faces
faces = Element.Faces(element=code_block_14)

# group: side face for A03AC035, A03AC036 (Form Work)
code_block_25 = CodeBlock { 0.5; }
normalAtParameter = Surface.NormalAtParameter(surface=faces, u=code_block_25, v=code_block_25)
Z = Vector.Z(vector=normalAtParameter)
code_block_26 = CodeBlock(i=Z) { i == 1 ||i == -1? false:true; }
filterByBoolMask_4 = List.FilterByBoolMask(list=faces, mask=code_block_26)

# group: calculation
area = Surface.Area(surface=filterByBoolMask_4.in)
code_block_27 = CodeBlock(num1=area) { num2 = Math.Sum(num1)/1000000; }

# group: instanace 별 wm 및 wm 물량값 매칭
code_block_28 = CodeBlock { "..."; }
join_2 = String.Join(separator=code_block_28)  # unwired: string0, string1
instance_별_계산값 = CodeBlock(i=code_block_27) { i; }
string_from_object_4 = FromObject(object=instance_별_계산값)
cartesianProduct = List.CartesianProduct(combineFunction=join_2, list0=getItemAtIndex_2, list1=string_from_object_4)
transpose_2 = List.Transpose(lists=cartesianProduct)

# group: 구체(RC) 관련 WM 추출
현재_카테고리_내에서_쓰일_total_wm_code_3 = CodeBlock(codeAll=현재_카테고리_내에서_쓰일_total_wm_full) { codeAll; }
code_block_29 = CodeBlock()
# ---------- code_block_29.designscript (6 lines) ----------
[

"Structural Concrete",
"Colored Concrete"

];
# ----------------------------------------
code_block_30 = CodeBlock(str=현재_카테고리_내에서_쓰일_total_wm_code_3, searchFor=code_block_29) { String.Contains(str<1>, searchFor, false); }
allFalse_2 = List.AllFalse(list=code_block_30@L2)
code_block_31 = CodeBlock { false; }
allIndicesOf_2 = List.AllIndicesOf(list=allFalse_2, item=code_block_31)
# note: 1 line text export
getItemAtIndex_3 = List.GetItemAtIndex(list=현재_카테고리_내에서_쓰일_total_wm_code_3, index=allIndicesOf_2)

# group: solids for A03AC032, A03AC033 (concrete)
solids_for_a03ac032_a03ac033 = CodeBlock(i=geometry_3) { i; }  # "solids for A03AC032, A03AC033 (concrete)"

# group: calculation
flatten = List.Flatten(list=solids_for_a03ac032_a03ac033)
code_block_32 = CodeBlock(i=flatten) { Solid.Volume(i)/1000000000; }

# group: instanace 별 wm 및 wm 물량값 매칭
code_block_33 = CodeBlock { "..."; }
join_3 = String.Join(separator=code_block_33)  # unwired: string0, string1
instance_별_계산값_2 = CodeBlock(i=code_block_32) { i; }
string_from_object_5 = FromObject(object=instance_별_계산값_2)
cartesianProduct_2 = List.CartesianProduct(combineFunction=join_3, list0=getItemAtIndex_3, list1=string_from_object_5)
transpose_3 = List.Transpose(lists=cartesianProduct_2)

# group: Protective Coating 관련 WM 추출
현재_카테고리_내에서_쓰일_total_wm_code_4 = CodeBlock(codeAll=현재_카테고리_내에서_쓰일_total_wm_full) { codeAll; }
code_block_34 = CodeBlock()
# ---------- code_block_34.designscript (5 lines) ----------
[

"Concrete Protective Coating (U/G)"

];
# ----------------------------------------
code_block_35 = CodeBlock(str=현재_카테고리_내에서_쓰일_total_wm_code_4, searchFor=code_block_34) { String.Contains(str<1>, searchFor, false); }
allFalse_3 = List.AllFalse(list=code_block_35@L2)
code_block_36 = CodeBlock { false; }
allIndicesOf_3 = List.AllIndicesOf(list=allFalse_3, item=code_block_36)
getItemAtIndex_4 = List.GetItemAtIndex(list=현재_카테고리_내에서_쓰일_total_wm_code_4, index=allIndicesOf_3)

# group: side face for A03AE056, A03AE057, A03AE058, A03AE059, A03AE060, A03AE061 (UG coating)
code_block_37 = CodeBlock { 0.5; }
normalAtParameter_2 = Surface.NormalAtParameter(surface=faces, u=code_block_37, v=code_block_37)
Z_2 = Vector.Z(vector=normalAtParameter_2)
code_block_38 = CodeBlock(i=Z_2) { i == 1 ||i == -1? false:true; }
filterByBoolMask_5 = List.FilterByBoolMask(list=faces, mask=code_block_38)

# group: calculation
area_2 = Surface.Area(surface=filterByBoolMask_5.in)
code_block_39 = CodeBlock(num1=area_2) { num2 = Math.Sum(num1)/1000000; }

# group: instanace 별 wm 및 wm 물량값 매칭
code_block_40 = CodeBlock { "..."; }
join_4 = String.Join(separator=code_block_40)  # unwired: string0, string1
instance_별_계산값_3 = CodeBlock(i=code_block_39) { i; }
string_from_object_6 = FromObject(object=instance_별_계산값_3)
cartesianProduct_3 = List.CartesianProduct(combineFunction=join_4, list0=getItemAtIndex_4, list1=string_from_object_6)
transpose_4 = List.Transpose(lists=cartesianProduct_3)

# group: export to excel
file_path_3 = Filename("C:\Users\HEC\Desktop\11.xlsx")
code_block_41 = CodeBlock { "Sheet1"; }
code_block_42 = CodeBlock { 1; }
code_block_43 = CodeBlock { true; }
exportExcel = Data.ExportExcel(filePath=file_path_3, sheetName=code_block_41, startRow=code_block_42, startCol=code_block_42, overWrite=code_block_43)  # unwired: data

현재_카테고리_내에서_쓰일_total_wm_full_2 = CodeBlock(codeAll=getItemAtIndex) { codeAll; }  # "현재 카테고리 내에서 쓰일 Total WM full code"

# group: 거푸집 관련 WM 추출
현재_카테고리_내에서_쓰일_total_wm_code_5 = CodeBlock(codeAll=현재_카테고리_내에서_쓰일_total_wm_full_2) { codeAll; }
code_block_44 = CodeBlock()  # same code as code_block_22
code_block_45 = CodeBlock(str=현재_카테고리_내에서_쓰일_total_wm_code_5, searchFor=code_block_44) { String.Contains(str<1>, searchFor, false); }
allFalse_4 = List.AllFalse(list=code_block_45@L2)
code_block_46 = CodeBlock { false; }
allIndicesOf_4 = List.AllIndicesOf(list=allFalse_4, item=code_block_46)
getItemAtIndex_5 = List.GetItemAtIndex(list=현재_카테고리_내에서_쓰일_total_wm_code_5, index=allIndicesOf_4)

# group: All faces
faces_2 = Element.Faces(element=code_block_18)

# group: side face for A03AC035, A03AC036 (Form Work)
code_block_47 = CodeBlock { 0.5; }
normalAtParameter_3 = Surface.NormalAtParameter(surface=faces_2, u=code_block_47, v=code_block_47)
Z_3 = Vector.Z(vector=normalAtParameter_3)
code_block_48 = CodeBlock(i=Z_3) { i == 1 ||i == -1? false:true; }
filterByBoolMask_6 = List.FilterByBoolMask(list=faces_2, mask=code_block_48)

# group: calculation
area_3 = Surface.Area(surface=filterByBoolMask_6.in)
code_block_49 = CodeBlock(num1=area_3) { num2 = Math.Sum(num1)/1000000; }

# group: instanace 별 wm 및 wm 물량값 매칭
code_block_50 = CodeBlock { "..."; }
join_5 = String.Join(separator=code_block_50)  # unwired: string0, string1
instance_별_계산값_4 = CodeBlock(i=code_block_49) { i; }
string_from_object_7 = FromObject(object=instance_별_계산값_4)
cartesianProduct_4 = List.CartesianProduct(combineFunction=join_5, list0=getItemAtIndex_5, list1=string_from_object_7)
transpose_5 = List.Transpose(lists=cartesianProduct_4)

# group: 구체(RC) 관련 WM 추출
현재_카테고리_내에서_쓰일_total_wm_code_6 = CodeBlock(codeAll=현재_카테고리_내에서_쓰일_total_wm_full_2) { codeAll; }
code_block_51 = CodeBlock()  # same code as code_block_29
code_block_52 = CodeBlock(str=현재_카테고리_내에서_쓰일_total_wm_code_6, searchFor=code_block_51) { String.Contains(str<1>, searchFor, false); }
allFalse_5 = List.AllFalse(list=code_block_52@L2)
code_block_53 = CodeBlock { false; }
allIndicesOf_5 = List.AllIndicesOf(list=allFalse_5, item=code_block_53)
getItemAtIndex_6 = List.GetItemAtIndex(list=현재_카테고리_내에서_쓰일_total_wm_code_6, index=allIndicesOf_5)

# group: solids for A03AC032, A03AC033 (concrete)
solids_for_a03ac032_a03ac033_2 = CodeBlock(i=geometry_4) { i; }  # "solids for A03AC032, A03AC033 (concrete)"

# group: calculation
flatten_2 = List.Flatten(list=solids_for_a03ac032_a03ac033_2)
code_block_54 = CodeBlock(i=flatten_2) { Solid.Volume(i)/1000000000; }

# group: instanace 별 wm 및 wm 물량값 매칭
code_block_55 = CodeBlock { "..."; }
join_6 = String.Join(separator=code_block_55)  # unwired: string0, string1
instance_별_계산값_5 = CodeBlock(i=code_block_54) { i; }
string_from_object_8 = FromObject(object=instance_별_계산값_5)
cartesianProduct_5 = List.CartesianProduct(combineFunction=join_6, list0=getItemAtIndex_6, list1=string_from_object_8)
transpose_6 = List.Transpose(lists=cartesianProduct_5)

# group: Protective Coating 관련 WM 추출
현재_카테고리_내에서_쓰일_total_wm_code_7 = CodeBlock(codeAll=현재_카테고리_내에서_쓰일_total_wm_full_2) { codeAll; }
code_block_56 = CodeBlock()
# ---------- code_block_56.designscript (5 lines) ----------
[

"Concrete Protective Coating (A/G)"

];
# ----------------------------------------
code_block_57 = CodeBlock(str=현재_카테고리_내에서_쓰일_total_wm_code_7, searchFor=code_block_56) { String.Contains(str<1>, searchFor, false); }
allFalse_6 = List.AllFalse(list=code_block_57@L2)
code_block_58 = CodeBlock { false; }
allIndicesOf_6 = List.AllIndicesOf(list=allFalse_6, item=code_block_58)
getItemAtIndex_7 = List.GetItemAtIndex(list=현재_카테고리_내에서_쓰일_total_wm_code_7, index=allIndicesOf_6)

# group: side face for A03AE056, A03AE057, A03AE058, A03AE059, A03AE060, A03AE061 (UG coating)
code_block_59 = CodeBlock { 0.5; }
normalAtParameter_4 = Surface.NormalAtParameter(surface=faces_2, u=code_block_59, v=code_block_59)
Z_4 = Vector.Z(vector=normalAtParameter_4)
code_block_60 = CodeBlock(i=Z_4) { i == 1 ||i == -1? false:true; }
filterByBoolMask_7 = List.FilterByBoolMask(list=faces_2, mask=code_block_60)

# group: calculation
area_4 = Surface.Area(surface=filterByBoolMask_7.in)
code_block_61 = CodeBlock(num1=area_4) { num2 = Math.Sum(num1)/1000000; }

# group: instanace 별 wm 및 wm 물량값 매칭
code_block_62 = CodeBlock { "..."; }
join_7 = String.Join(separator=code_block_62)  # unwired: string0, string1
instance_별_계산값_6 = CodeBlock(i=code_block_61) { i; }
string_from_object_9 = FromObject(object=instance_별_계산값_6)
cartesianProduct_6 = List.CartesianProduct(combineFunction=join_7, list0=getItemAtIndex_7, list1=string_from_object_9)
transpose_7 = List.Transpose(lists=cartesianProduct_6)

code_block_63 = CodeBlock {  }
code_block_64 = CodeBlock { "..."; }
join_8 = String.Join(separator=code_block_64)  # unwired: string0, string1

# group: 인스턴스 이름과 위치 정보
code_block_65 = CodeBlock(i=code_block_14) { i; }
code_block_66 = CodeBlock { "Type"; }
getParameterValueByName_3 = Element.GetParameterValueByName(element=code_block_65, parameterName=code_block_66)
code_block_67 = CodeBlock { "Base Level"; }
getParameterValueByName_4 = Element.GetParameterValueByName(element=code_block_65, parameterName=code_block_67)
string_from_object_10 = FromObject(object=getParameterValueByName_4)
code_block_68 = CodeBlock { ", "; }
split = String.Split(str=string_from_object_10, separator0=code_block_68)
code_block_69 = CodeBlock { -1; }
takeItems = List.TakeItems(list=split@L2, amount=code_block_69)
code_block_70 = CodeBlock(i=takeItems) { String.Length(i)-1; }
code_block_71 = CodeBlock { -1; }
remove = String.Remove(string=takeItems, startIndex=code_block_70, count=code_block_71)
flatten_3 = List.Flatten(list=remove)
code_block_72 = CodeBlock { "Column Location Mark"; }
getParameterValueByName_5 = Element.GetParameterValueByName(element=code_block_65, parameterName=code_block_72)
string_from_object_11 = FromObject(object=getParameterValueByName_5)
code_block_73 = CodeBlock(i=getParameterValueByName_3, j=flatten_3, k=string_from_object_11) { i+"..."+j+"..."+k; }

code_block_74 = CodeBlock(i=code_block_73) { i; }
code_block_75 = CodeBlock(t1=cartesianProduct_2, t2=cartesianProduct, t3=cartesianProduct_3) { q = List.Join([t1<1>, t2<1>, t3<1>]); }
count_2 = List.Count(list=code_block_75)
python_script = Python(IN[0]=code_block_74, IN[1]=count_2)  # IronPython2
# ---------- python_script.python (20 lines) ----------
# Load the Python Standard and DesignScript Libraries
import sys
import clr
clr.AddReference('ProtoGeometry')
from Autodesk.DesignScript.Geometry import *

# The inputs to this node will be stored as a list in the IN variables.
dataEnteringNode = IN
inputList = IN[0]
cycleCnt = IN[1]
outlist = []

# Place your code below this line

for i in inputList:
	for j in range(cycleCnt):
		outlist.append(i)

# Assign your output to the OUT variable.
OUT = outlist
# ----------------------------------------
transpose_8 = List.Transpose(lists=code_block_75)
flatten_4 = List.Flatten(list=transpose_8)
laceShortest = List.LaceShortest(combineFunction=join_8, list0=python_script, list1=flatten_4)
code_block_76 = CodeBlock { "..."; }
split_2 = String.Split(str=laceShortest, separator0=code_block_76)
code_block_77 = CodeBlock { "..."; }
join_9 = String.Join(separator=code_block_77)  # unwired: string0, string1

# group: 인스턴스 이름과 위치 정보
code_block_78 = CodeBlock(i=code_block_18) { i; }
code_block_79 = CodeBlock { "Type"; }
getParameterValueByName_6 = Element.GetParameterValueByName(element=code_block_78, parameterName=code_block_79)
code_block_80 = CodeBlock { "Base Level"; }
getParameterValueByName_7 = Element.GetParameterValueByName(element=code_block_78, parameterName=code_block_80)
string_from_object_12 = FromObject(object=getParameterValueByName_7)
code_block_81 = CodeBlock { ", "; }
split_3 = String.Split(str=string_from_object_12, separator0=code_block_81)
code_block_82 = CodeBlock { -1; }
takeItems_2 = List.TakeItems(list=split_3@L2, amount=code_block_82)
code_block_83 = CodeBlock(i=takeItems_2) { String.Length(i)-1; }
code_block_84 = CodeBlock { -1; }
remove_2 = String.Remove(string=takeItems_2, startIndex=code_block_83, count=code_block_84)
flatten_5 = List.Flatten(list=remove_2)
code_block_85 = CodeBlock { "Column Location Mark"; }
getParameterValueByName_8 = Element.GetParameterValueByName(element=code_block_78, parameterName=code_block_85)
string_from_object_13 = FromObject(object=getParameterValueByName_8)
code_block_86 = CodeBlock(i=getParameterValueByName_6, j=flatten_5, k=string_from_object_13) { i+"..."+j+"..."+k; }

code_block_87 = CodeBlock(i=code_block_86) { i; }
code_block_88 = CodeBlock(t1=cartesianProduct_5, t2=cartesianProduct_4, t3=cartesianProduct_6) { q = List.Join([t1<1>, t2<1>, t3<1>]); }
count_3 = List.Count(list=code_block_88)
python_script_2 = Python(IN[0]=code_block_87, IN[1]=count_3)  # IronPython2; same code as python_script
transpose_9 = List.Transpose(lists=code_block_88)
flatten_6 = List.Flatten(list=transpose_9)
laceShortest_2 = List.LaceShortest(combineFunction=join_9, list0=python_script_2, list1=flatten_6)
code_block_89 = CodeBlock { "..."; }
split_4 = String.Split(str=laceShortest_2, separator0=code_block_89)
join_10 = List.Join(list0=split_2, list1=split_4)

# group: All solids
geometry_5 = Element.Geometry(element=code_block_18)

explode = Geometry.Explode(geometry=geometry_5)
flatten_7 = List.Flatten(list=explode)
code_block_90 = CodeBlock { 0.5; }
normalAtParameter_5 = Surface.NormalAtParameter(surface=flatten_7, u=code_block_90, v=code_block_90)
Z_5 = Vector.Z(vector=normalAtParameter_5@L2)
code_block_91 = CodeBlock { 2; }
round = Math.Round(number=Z_5, digits=code_block_91)
code_block_92 = CodeBlock(a=round) { a==0; a>0; a<0; a==-1; }
filterByBoolMask_8 = List.FilterByBoolMask(list=flatten_7, mask=code_block_92.out1@L2)
flatten_8 = List.Flatten(list=filterByBoolMask_8.in)
byGeometry = BoundingBox.ByGeometry(geom=flatten_8@L1)
toCuboid = BoundingBox.ToCuboid(boundingBox=byGeometry)
explode_2 = Geometry.Explode(geometry=toCuboid)
perimeterCurves = Surface.PerimeterCurves(surface=explode_2)
startPoint = Curve.StartPoint(curve=perimeterCurves)
boolean = BoolSelector(true)
byPoints = PolyCurve.ByPoints(points=startPoint, connectLastToFirst=boolean)
code_block_93 = CodeBlock { 50; }
offset = Curve.Offset(curve=byPoints, distance=code_block_93)
ZAxis = Vector.ZAxis()
reverse = Vector.Reverse(vector=ZAxis)
code_block_94 = CodeBlock { "Length"; }
getParameterValueByName_9 = Element.GetParameterValueByName(element=code_block_18, parameterName=code_block_94)
watch_13 = Watch(getParameterValueByName_9)
extrudeAsSolid = Curve.ExtrudeAsSolid(curve=offset, direction=reverse, distance=watch_13)
watch_14 = Watch(extrudeAsSolid)
watch_15 = Watch(geometry_5)
differenceAll = Solid.DifferenceAll(solid=watch_14, others=watch_15, lacing=Shortest)
volume_3 = Solid.Volume(solid=differenceAll)
watch_16 = Watch(volume_3)
flatten_9 = List.Flatten(list=filterByBoolMask_8.in)
perimeterCurves_2 = Surface.PerimeterCurves(surface=flatten_9)
startPoint_2 = Curve.StartPoint(curve=perimeterCurves_2)
boolean_2 = BoolSelector(true)
byPoints_2 = PolyCurve.ByPoints(points=startPoint_2, connectLastToFirst=boolean_2)
code_block_95 = CodeBlock { 0; }
offset_2 = Curve.Offset(curve=byPoints_2, distance=code_block_95)

# group: 접한 요소와의 공재 범위 확인 필요
ZAxis_2 = Vector.ZAxis()
reverse_2 = Vector.Reverse(vector=ZAxis_2)
extrudeAsSolid_2 = Curve.ExtrudeAsSolid(curve=offset_2, direction=reverse_2, distance=watch_13)
area_5 = Solid.Area(solid=extrudeAsSolid_2)
extrude = Curve.Extrude(curve=offset_2, direction=reverse_2, distance=watch_13)
area_6 = Surface.Area(surface=extrude)
