# Dynamo graph Str Framing Calculator_HEC(0625).dyn "Str Framing Calculator(0625)" (Dynamo 2.10.1.3976)

# group: Str Framing
code_block = CodeBlock {  }
code_block_2 = CodeBlock {  }

# group: select all Category element
categories = Categories("OST_StructuralFraming")
all_elements_of_category = ElementsOfCategory(Category=categories)
code_block_3 = CodeBlock { "Reference Level"; }
parameterByName = Parameter.ParameterByName(element=all_elements_of_category, name=code_block_3)
string_from_object = FromObject(object=parameterByName)
uniqueItems = List.UniqueItems(list=string_from_object)
code_block_4 = CodeBlock(i=string_from_object, j=uniqueItems) { i == j[0]; }
filterByBoolMask = List.FilterByBoolMask(list=all_elements_of_category, mask=code_block_4)

watch = Watch(all_elements_of_category)
elementType = Element.ElementType(element=watch)
familyName = ElementType.FamilyName(elementType=elementType)
watch_2 = Watch(familyName)
string_from_object_2 = FromObject(object=watch_2)
code_block_5 = CodeBlock { "Concrete"; }
contains = String.Contains(str=string_from_object_2, searchFor=code_block_5)
filterByBoolMask_2 = List.FilterByBoolMask(list=all_elements_of_category, mask=contains)
watch_3 = Watch(filterByBoolMask_2.out)
name = FamilyType.Name(familyType=watch_3)
string_from_object_3 = FromObject(object=name)
code_block_6 = CodeBlock { "BH-"; }
contains_2 = String.Contains(str=string_from_object_3, searchFor=code_block_6)
filterByBoolMask_3 = List.FilterByBoolMask(list=watch_3, mask=contains_2)
watch_4 = Watch(filterByBoolMask_3.out)
watch_5 = Watch(filterByBoolMask_2.in)

# group: surface
watch_6 = Watch(watch_4)
geometry = Element.Geometry(element=watch_6)
watch_7 = Watch(geometry)
watch_8 = Watch(watch_5)
geometry_2 = Element.Geometry(element=watch_8)
watch_9 = Watch(geometry_2)
faces = Element.Faces(element=watch_8)
faces_2 = Element.Faces(element=watch_6)

flatten = List.Flatten(list=faces)
flatten_2 = List.Flatten(list=faces_2)
area = Surface.Area()  # unwired: surface
area_2 = Surface.Area()  # unwired: surface

# group: Unit Weight 추출 전
watch_10 = Watch(all_elements_of_category)
code_block_7 = CodeBlock(a=watch_10) { a[0]; }
parameters = Element.Parameters(element=code_block_7)
name_2 = Parameter.Name(parameter=parameters)
code_block_8 = CodeBlock { "Unit Weight"; "Weight"; "weight"; }
contains_3 = String.Contains(str=name_2, searchFor=code_block_8.out2)
countTrue = List.CountTrue(list=contains_3)
watch_11 = Watch(countTrue)
watch_12 = Watch()  # unwired: arg0

# note: Built up
watch_13 = Watch(filterByBoolMask_3.in)

# group: Unit weight x element length
code_block_9 = CodeBlock { "Length"; }
getParameterValueByName = Element.GetParameterValueByName(element=watch_10, parameterName=code_block_9)

code_block_10 = CodeBlock { UW; }  # unwired: UW
code_block_11 = CodeBlock { 90; 30; }
# note: Built up 제외외
ge = code_block_10 >= code_block_11.out0
lt = code_block_10 < code_block_11.out1
ge_2 = code_block_10 >= code_block_11.out1
# note: Built up 자제만
watch_14 = Watch(ge_2)
le = watch_14 <= code_block_11.out0
