# Dynamo graph Wall Calculator_HEC(0628).dyn "Wall Calculator(0628)" (Dynamo 2.10.1.3976)

# group: select all Category element
categories = Categories("OST_Walls")
all_elements_of_category = ElementsOfCategory(Category=categories)

# group: select all Category element by level
code_block = CodeBlock { "Base Constraint"; }
getParameterValueByName = Element.GetParameterValueByName(parameterName=code_block)  # unwired: element
groupByFunction = List.GroupByFunction(list=all_elements_of_category, groupFunction=getParameterValueByName)

# group: Family Type 별 sorting
elementType = Element.ElementType()  # unwired: element
uniqueItems = List.UniqueItems(list=elementType)
groupByFunction_2 = List.GroupByFunction(list=groupByFunction@L2, groupFunction=uniqueItems)

# group: element-wm 별 면적(m2) 물량 추출 구간
code_block_2 = CodeBlock { "Area"; }
getParameterValueByName_2 = Element.GetParameterValueByName(element=groupByFunction_2, parameterName=code_block_2)
flatten = List.Flatten(list=getParameterValueByName_2)
watch = Watch(flatten)
getMaterials = Element.GetMaterials(element=groupByFunction_2)
count = List.Count(list=getMaterials@L2)
ofRepeatedItem = List.OfRepeatedItem(item=watch, amount=count, lacing=Shortest)
flatten_2 = List.Flatten(list=ofRepeatedItem)

watch_2 = Watch(flatten_2)
watch_3 = Watch(getMaterials)
name = Material.Name(material=watch_3)
watch_4 = Watch(name)
flatten_3 = List.Flatten(list=watch_4)

# group: input list 에서 대상문자열들 포함하는 index 추출(for line base)
대상_문자열 = CodeBlock()
# ---------- 대상_문자열.designscript (5 lines) ----------
[

"Skirt"

];
# ----------------------------------------
code_block_3 = CodeBlock(str=flatten_3, searchFor=대상_문자열) { String.Contains(str<1>, searchFor, false); }
allFalse = List.AllFalse(list=code_block_3@L2)
code_block_4 = CodeBlock { false; }
allIndicesOf = List.AllIndicesOf(list=allFalse, item=code_block_4)

# group: element-wm 별 길이(m) 물량 추출 구간
code_block_5 = CodeBlock { "Length"; }
getParameterValueByName_3 = Element.GetParameterValueByName(element=groupByFunction_2, parameterName=code_block_5)
flatten_4 = List.Flatten(list=getParameterValueByName_3)
watch_5 = Watch(flatten_4)
getMaterials_2 = Element.GetMaterials(element=groupByFunction_2)
count_2 = List.Count(list=getMaterials_2@L2)
ofRepeatedItem_2 = List.OfRepeatedItem(item=watch_5, amount=count_2, lacing=Shortest)
flatten_5 = List.Flatten(list=ofRepeatedItem_2)

code_block_6 = CodeBlock(i=flatten_5) { i / 1000; }
watch_6 = Watch(code_block_6)

# group: element-wm 별 적합 물량 매칭 구간 (unit:m2 base, unit:m modify)
watch_7 = Watch(flatten_2)
watch_8 = Watch(allIndicesOf)
getItemAtIndex = List.GetItemAtIndex(list=watch_6, index=allIndicesOf)
watch_9 = Watch(getItemAtIndex)
code_block_7 = CodeBlock(inList=watch_7, replaceIndex=watch_8, replaceValue=watch_9)
# ---------- code_block_7.designscript (6 lines) ----------
numIndex = 0..List.Count(inList)-1;
numIndexDiffer = List.SetDifference(numIndex,replaceIndex);
numIndexFlatten = List.Flatten([numIndexDiffer,replaceIndex],-1);
bln1 = List.Contains(replaceIndex,numIndex<1>);
outList = List.FilterByBoolMask(inList,bln1);
outListFlatten = List.Flatten([outList["out"],replaceValue],-1);
# ----------------------------------------
watch_10 = Watch(code_block_7.bln1)
watch_11 = Watch(code_block_7.outList)
sortByKey = List.SortByKey(list=code_block_7.outListFlatten, keys=code_block_7.numIndexFlatten)
watch_12 = Watch(sortByKey.sortedList)

# group: element 별 위치정보 삽입 구간
code_block_8 = CodeBlock {  }
code_block_9 = CodeBlock {  }

# group: wm 별 할증값 생성구간
code_block_10 = CodeBlock {  }
code_block_11 = CodeBlock {  }

# group: Excel Import
file_path = Filename("..\..\07_3D 기반 물량 집계 자동화\BIM_물량집계 자동화 산출기준표_rC(20210617)_mk.xlsx")
file_from_path = FileObject(path=file_path)
code_block_12 = CodeBlock { "Scope_lv2(Walls)"; }
code_block_13 = CodeBlock { false; }
importExcel = Data.ImportExcel(file=file_from_path, sheetName=code_block_12, showExcel=code_block_13)

# group: Null값 처리
code_block_14 = CodeBlock { " "; }
isNull = Object.IsNull()  # unwired: object
replaceByCondition = Replace(item=importExcel, replaceWith=code_block_14, condition=isNull)

# group: Whole Data(row direction)
watch_13 = Watch(replaceByCondition)

identity = Object.Identity(object=watch_13)
identity_2 = Object.Identity(object=identity)
code_block_15 = CodeBlock(i=identity_2) { i[3]; }
watch_14 = Watch(code_block_15)
rank = List.Rank(list=watch_4@L3)

# group: Whole Data(Column direction)
transpose = List.Transpose(lists=replaceByCondition)
watch_15 = Watch(transpose)

# group: Column Index Guide
code_block_16 = CodeBlock(i=watch_13) { i[3]; }
watch_16 = Watch(code_block_16)

# group: 모델링에 사용된 모든 패밀리타입 코드 추출
elementType_2 = Element.ElementType(element=groupByFunction)
name_2 = Element.Name(element=elementType_2)
uniqueItems_2 = List.UniqueItems(list=name_2@L2)
flatten_6 = List.Flatten(list=uniqueItems_2)
watch_17 = Watch(flatten_6)
code_block_17 = CodeBlock { "_"; }
split = String.Split(str=watch_17, separator0=code_block_17)
firstItem = List.FirstItem(list=split@L2)

# group: 사용된 패밀리타입이 위치한 Column Index 추출
string_from_object = FromObject(obj=watch_16)
contains = String.Contains(searchFor=firstItem, lacing=CrossProduct)  # unwired: str
map = List.Map(list=string_from_object, f_x=contains)
allFalse_2 = List.AllFalse(list=map@L2)
code_block_18 = CodeBlock(i=allFalse_2) { i==false?true:false; }
code_block_19 = CodeBlock { true; }
allIndicesOf_2 = List.AllIndicesOf(list=code_block_18, item=code_block_19)

# group: 사용된 패밀리타입 Column Data 추출
identity_3 = Object.Identity(object=allIndicesOf_2@L1)
getItemAtIndex_2 = List.GetItemAtIndex(list=watch_15, index=identity_3)
code_block_20 = CodeBlock { 4; ""; }
# note: 불필요 정보 처리
replaceItemAtIndex = List.ReplaceItemAtIndex(list=getItemAtIndex_2@L2, index=code_block_20.out0, item=code_block_20.out1)
watch_18 = Watch(getItemAtIndex_2)

watch_19 = Watch(replaceItemAtIndex)

# group: 사용된 패밀리 타입에서 세부코드가 기입된 Row 열 번호 추출
string_from_object_2 = FromObject(obj=replaceItemAtIndex)
code_block_21 = CodeBlock { "000"; }
contains_2 = String.Contains(str=string_from_object_2@L2, searchFor=code_block_21, lacing=CrossProduct)
code_block_22 = CodeBlock { true; }
allIndicesOf_3 = List.AllIndicesOf(list=contains_2@L2, item=code_block_22)
watch_20 = Watch(allIndicesOf_3)

getItemAtIndex_3 = List.GetItemAtIndex(list=identity_2, index=watch_20@L2)
watch_21 = Watch(getItemAtIndex_3)
code_block_23 = CodeBlock { 0; }
getItemAtIndex_4 = List.GetItemAtIndex(list=watch_21@@L2, index=code_block_23)
watch_22 = Watch(getItemAtIndex_4)
getItemAtIndex_5 = List.GetItemAtIndex(list=watch_19@L2, index=watch_20@L2)
watch_23 = Watch(getItemAtIndex_5)
code_block_24 = CodeBlock(i=watch_22, j=watch_23) { i + "-" + j; }

# group: Wall Type: WM Code 딕셔너리 생성(벽체 layer에 포함 되지 않은 WM code 까지 포함되어야함)
code_block_25 = CodeBlock { 3; }
getItemAtIndex_6 = List.GetItemAtIndex(list=watch_19@L2, index=code_block_25)
code_block_26 = CodeBlock { "_"; "-"; }
split_2 = String.Split(str=getItemAtIndex_6, separator0=code_block_26.out0, separator1=code_block_26.out1)
firstItem_2 = List.FirstItem(list=split_2@L2)
byKeysValues = DesignScript.Builtin.Dictionary.ByKeysValues(keys=firstItem_2, values=code_block_24)
watch_24 = Watch(byKeysValues)

watch_25 = Watch(firstItem)

# group: Family Type 별 sorting
elementType_3 = Element.ElementType()  # unwired: element
uniqueItems_3 = List.UniqueItems(list=elementType_3)
groupByFunction_3 = List.GroupByFunction(list=all_elements_of_category@L2, groupFunction=uniqueItems_3)

byKeysValues_2 = DesignScript.Builtin.Dictionary.ByKeysValues(keys=watch_25, values=groupByFunction_3@L3)
components = DesignScript.Builtin.Dictionary.Components(dictionary=byKeysValues_2)

# group: select all Category element by level
code_block_27 = CodeBlock { "Base Constraint"; }
getParameterValueByName_4 = Element.GetParameterValueByName(parameterName=code_block_27)  # unwired: element
groupByFunction_4 = List.GroupByFunction(list=components.values@L2, groupFunction=getParameterValueByName_4)

byKeysValues_3 = DesignScript.Builtin.Dictionary.ByKeysValues(keys=components.keys, values=components.values@L3)
count_3 = List.Count(list=ofRepeatedItem_2@L2)
sublists = List.Sublists(list=code_block_6, ranges=count_3)  # unwired: offset

# group: Row Index Guide
code_block_28 = CodeBlock(i=watch_15) { i[3]; }
watch_26 = Watch(code_block_28)

parameters = Element.Parameters(element=groupByFunction_2)
watch_27 = Watch(parameters)

# group: grid개체
categories_2 = Categories("OST_Grids")
all_elements_of_category_2 = ElementsOfCategory(Category=categories_2)
parameters_2 = Element.Parameters(element=all_elements_of_category_2)
name_3 = Element.Name(element=all_elements_of_category_2)
geometry = Element.Geometry(element=all_elements_of_category_2)

identity_4 = Object.Identity(object=groupByFunction_2)
identity_5 = Object.Identity(object=identity_4)
count_4 = List.Count(list=getMaterials@L2)
identity_6 = Object.Identity(object=count_4)

# group: input list 에서 대상문자열들 포함하는 index 추출(for forms)
대상_문자열_2 = CodeBlock()
# ---------- 대상_문자열_2.designscript (7 lines) ----------
[

"Form",
"Plastering"


];
# ----------------------------------------
code_block_29 = CodeBlock(str=flatten_3, searchFor=대상_문자열_2) { String.Contains(str<1>, searchFor, false); }
allFalse_3 = List.AllFalse(list=code_block_29@L2)
code_block_30 = CodeBlock { false; }
allIndicesOf_4 = List.AllIndicesOf(list=allFalse_3, item=code_block_30)

element_wm_별_면적_형상 = CodeBlock(i=flatten_2) { i; }

# group: element-wm 별 적합 물량 매칭 구간(벽체 양쪽 적용 WM Code modify)
watch_28 = Watch(watch_12)
watch_29 = Watch(allIndicesOf_4)
getItemAtIndex_7 = List.GetItemAtIndex(list=element_wm_별_면적_형상, index=allIndicesOf_4)

form_물량_보정 = CodeBlock(i=getItemAtIndex_7) { i * 2; }

# group (continued): element-wm 별 적합 물량 매칭 구간(벽체 양쪽 적용 WM Code modify)
watch_30 = Watch(form_물량_보정)
code_block_31 = CodeBlock(inList=watch_28, replaceIndex=watch_29, replaceValue=watch_30)  # same code as code_block_7
sortByKey_2 = List.SortByKey(list=code_block_31.outListFlatten, keys=code_block_31.numIndexFlatten)
watch_31 = Watch(sortByKey_2.sortedList)

# group: element 별 Family Type 삽입 구간
identity_7 = Object.Identity(object=identity_5)
elementType_4 = Element.ElementType(element=identity_7@L1)
name_4 = Element.Name(element=elementType_4)
ofRepeatedItem_3 = List.OfRepeatedItem(item=name_4, amount=identity_6, lacing=Shortest)
watch_32 = Watch(watch_31)

watch_33 = Watch(ofRepeatedItem_3)

# group (continued): element 별 Family Type 삽입 구간
code_block_32 = CodeBlock(i=watch_33, j=watch_32) { i + "..." + j; }

identity_8 = Object.Identity(object=flatten_3)
identity_9 = Object.Identity(object=identity_8)

# group: element 별 WM code 삽입 구간
watch_34 = Watch(code_block_32)
watch_35 = Watch(identity_9)
code_block_33 = CodeBlock(i=watch_34, j=watch_35) { i + "..." + j; }
watch_36 = Watch(code_block_33)

# group: Data arrange for excel
flatten_7 = List.Flatten(list=watch_36)
code_block_34 = CodeBlock { "..."; }
split_3 = String.Split(str=flatten_7, separator0=code_block_34)
watch_37 = Watch(split_3)

# group: Excel Export
file_path_2 = Filename("C:\Users\HEC\Desktop\Wall Calculation sheet.xlsx")
code_block_35 = CodeBlock { "Wall Calculation"; }
code_block_36 = CodeBlock { 0; }
boolean = BoolSelector(true)
exportExcel = Data.ExportExcel(filePath=file_path_2, sheetName=code_block_35, startRow=code_block_36, startCol=code_block_36, data=watch_37, overWrite=boolean)  # frozen
