# Dynamo graph Wall Calculator_HEC_test(0708).dyn (Dynamo 2.10.1.3976)
# packages: archi-lab.net 2022.210.2122

# group: select all Category element
categories = Categories("OST_Walls")
all_elements_of_category = ElementsOfCategory(Category=categories)

# group: select all Category element by level
code_block = CodeBlock { "Base Constraint"; }
getParameterValueByName = Element.GetParameterValueByName(parameterName=code_block)  # unwired: element
groupByFunction = List.GroupByFunction(list=all_elements_of_category, groupFunction=getParameterValueByName)

# group: Family Type 별 sorting
elementType = Element.ElementType()  # unwired: element
uniqueItems = List.UniqueItems(list=elementType)
groupByFunction_2 = List.GroupByFunction(list=groupByFunction@L2, groupFunction=uniqueItems)

# group: element-wm 별 면적(m2) 물량 추출 구간
code_block_2 = CodeBlock { "Area"; }
getParameterValueByName_2 = Element.GetParameterValueByName(element=groupByFunction_2, parameterName=code_block_2)
flatten = List.Flatten(list=getParameterValueByName_2)
watch = Watch(flatten)
getMaterials = Element.GetMaterials(element=groupByFunction_2)
count = List.Count(list=getMaterials@L2)
ofRepeatedItem = List.OfRepeatedItem(item=watch, amount=count, lacing=Shortest)
flatten_2 = List.Flatten(list=ofRepeatedItem)

watch_2 = Watch(flatten_2)
watch_3 = Watch(getMaterials)
name = Material.Name(material=watch_3)
watch_4 = Watch(name)
flatten_3 = List.Flatten(list=watch_4)

# group: input list 에서 대상문자열들 포함하는 index 추출(for line base)
대상_문자열 = CodeBlock()
# ---------- 대상_문자열.designscript (5 lines) ----------
[

"Skirt"

];
# ----------------------------------------
code_block_3 = CodeBlock(str=flatten_3, searchFor=대상_문자열) { String.Contains(str<1>, searchFor, false); }
allFalse = List.AllFalse(list=code_block_3@L2)
code_block_4 = CodeBlock { false; }
allIndicesOf = List.AllIndicesOf(list=allFalse, item=code_block_4)

# group: element-wm 별 길이(m) 물량 추출 구간
code_block_5 = CodeBlock { "Length"; }
getParameterValueByName_3 = Element.GetParameterValueByName(element=groupByFunction_2, parameterName=code_block_5)
flatten_4 = List.Flatten(list=getParameterValueByName_3)
watch_5 = Watch(flatten_4)
getMaterials_2 = Element.GetMaterials(element=groupByFunction_2)
count_2 = List.Count(list=getMaterials_2@L2)
ofRepeatedItem_2 = List.OfRepeatedItem(item=watch_5, amount=count_2, lacing=Shortest)
flatten_5 = List.Flatten(list=ofRepeatedItem_2)

code_block_6 = CodeBlock(i=flatten_5) { i / 1000; }
watch_6 = Watch(code_block_6)

# group: element-wm 별 적합 물량 매칭 구간 (unit:m2 base, unit:m modify)
watch_7 = Watch(flatten_2)
watch_8 = Watch(allIndicesOf)
getItemAtIndex = List.GetItemAtIndex(list=watch_6, index=allIndicesOf)
watch_9 = Watch(getItemAtIndex)
code_block_7 = CodeBlock(inList=watch_7, replaceIndex=watch_8, replaceValue=watch_9)
# ---------- code_block_7.designscript (6 lines) ----------
numIndex = 0..List.Count(inList)-1;
numIndexDiffer = List.SetDifference(numIndex,replaceIndex);
numIndexFlatten = List.Flatten([numIndexDiffer,replaceIndex],-1);
bln1 = List.Contains(replaceIndex,numIndex<1>);
outList = List.FilterByBoolMask(inList,bln1);
outListFlatten = List.Flatten([outList["out"],replaceValue],-1);
# ----------------------------------------
watch_10 = Watch(code_block_7.bln1)
watch_11 = Watch(code_block_7.outList)
sortByKey = List.SortByKey(list=code_block_7.outListFlatten, keys=code_block_7.numIndexFlatten)
watch_12 = Watch(sortByKey.sortedList)

# group: element 별 위치정보 삽입 구간
code_block_8 = CodeBlock {  }
code_block_9 = CodeBlock {  }

# group: wm 별 할증값 생성구간
code_block_10 = CodeBlock {  }
code_block_11 = CodeBlock {  }

# group: Excel Import
file_path = Filename("..\BIM_물량집계 자동화 산출기준표_rC(20210607)_mk_de.xlsx")
file_from_path = FileObject(path=file_path)
code_block_12 = CodeBlock { "Scope_lv2(Walls)"; }
code_block_13 = CodeBlock { false; }
importExcel = Data.ImportExcel(file=file_from_path, sheetName=code_block_12, showExcel=code_block_13)

# group: Null값 처리
code_block_14 = CodeBlock { " "; }
isNull = Object.IsNull()  # unwired: object
replaceByCondition = Replace(item=importExcel, replaceWith=code_block_14, condition=isNull)

# group: Whole Data(row direction)
watch_13 = Watch(replaceByCondition)

identity = Object.Identity(object=watch_13)
rank = List.Rank(list=watch_4@L3)

# group: 모델링에 사용된 모든 패밀리타입 코드 추출
elementType_2 = Element.ElementType(element=all_elements_of_category)
name_2 = Element.Name(element=elementType_2)
uniqueItems_2 = List.UniqueItems(list=name_2@L2)
flatten_6 = List.Flatten(list=uniqueItems_2)
watch_14 = Watch(flatten_6)
code_block_15 = CodeBlock { "_"; }
split = String.Split(str=watch_14, separator0=code_block_15)
firstItem = List.FirstItem(list=split@L2)

watch_15 = Watch(firstItem)

# group: Family Type 별 sorting
elementType_3 = Element.ElementType()  # unwired: element
uniqueItems_3 = List.UniqueItems(list=elementType_3)
groupByFunction_3 = List.GroupByFunction(list=all_elements_of_category@L2, groupFunction=uniqueItems_3)

byKeysValues = DesignScript.Builtin.Dictionary.ByKeysValues(keys=watch_15, values=groupByFunction_3@L3)
components = DesignScript.Builtin.Dictionary.Components(dictionary=byKeysValues)

# group: select all Category element by level
code_block_16 = CodeBlock { "Base Constraint"; }
getParameterValueByName_4 = Element.GetParameterValueByName(parameterName=code_block_16)  # unwired: element
groupByFunction_4 = List.GroupByFunction(list=components.values@L2, groupFunction=getParameterValueByName_4)

byKeysValues_2 = DesignScript.Builtin.Dictionary.ByKeysValues(keys=components.keys, values=components.values@L3)
count_3 = List.Count(list=ofRepeatedItem_2@L2)
sublists = List.Sublists(list=code_block_6, ranges=count_3)  # unwired: offset

# group: Whole Data(Column direction)
transpose = List.Transpose(lists=replaceByCondition)
watch_16 = Watch(transpose)

# group: Row Index Guide
code_block_17 = CodeBlock(i=watch_16) { i[3]; }
watch_17 = Watch(code_block_17)

# group: Column Index Guide
code_block_18 = CodeBlock(i=watch_13) { i[3]; }
watch_18 = Watch(code_block_18)

# group: 사용된 패밀리타입이 위치한 Column Index 추출
string_from_object = FromObject(obj=watch_18)
contains = String.Contains(searchFor=firstItem, lacing=CrossProduct)  # unwired: str
map = List.Map(list=string_from_object, f_x=contains)
allFalse_2 = List.AllFalse(list=map@L2)
code_block_19 = CodeBlock(i=allFalse_2) { i==false?true:false; }
code_block_20 = CodeBlock { true; }
allIndicesOf_2 = List.AllIndicesOf(list=code_block_19, item=code_block_20)

# group: 사용된 패밀리타입 Column Data 추출
watch_19 = Watch(allIndicesOf_2)
getItemAtIndex_2 = List.GetItemAtIndex(list=watch_16, index=watch_19)
watch_20 = Watch(getItemAtIndex_2)
code_block_21 = CodeBlock { 4; ""; }
# note: 불필요 정보 처리
replaceItemAtIndex = List.ReplaceItemAtIndex(list=getItemAtIndex_2@L2, index=code_block_21.out0, item=code_block_21.out1)

parameters = Element.Parameters(element=groupByFunction_2)
watch_21 = Watch(parameters)

# group: grid개체
categories_2 = Categories("OST_Grids")
all_elements_of_category_2 = ElementsOfCategory(Category=categories_2)
parameters_2 = Element.Parameters(element=all_elements_of_category_2)
name_3 = Element.Name(element=all_elements_of_category_2)
geometry = Element.Geometry(element=all_elements_of_category_2)

identity_2 = Object.Identity(object=groupByFunction_2)
identity_3 = Object.Identity(object=identity_2)
count_4 = List.Count(list=getMaterials@L2)
identity_4 = Object.Identity(object=count_4)

# group: input list 에서 대상문자열들 포함하는 index 추출(for forms)
대상_문자열_2 = CodeBlock()
# ---------- 대상_문자열_2.designscript (7 lines) ----------
[

"Form",
"Plastering"


];
# ----------------------------------------
code_block_22 = CodeBlock(str=flatten_3, searchFor=대상_문자열_2) { String.Contains(str<1>, searchFor, false); }
allFalse_3 = List.AllFalse(list=code_block_22@L2)
code_block_23 = CodeBlock { false; }
allIndicesOf_3 = List.AllIndicesOf(list=allFalse_3, item=code_block_23)

element_wm_별_면적_형상 = CodeBlock(i=flatten_2) { i; }

# group: element-wm 별 적합 물량 매칭 구간(벽체 양쪽 적용 WM Code modify)
watch_22 = Watch(watch_12)
watch_23 = Watch(allIndicesOf_3)
getItemAtIndex_3 = List.GetItemAtIndex(list=element_wm_별_면적_형상, index=allIndicesOf_3)

form_물량_보정 = CodeBlock(i=getItemAtIndex_3) { i * 2; }

# group (continued): element-wm 별 적합 물량 매칭 구간(벽체 양쪽 적용 WM Code modify)
watch_24 = Watch(form_물량_보정)
code_block_24 = CodeBlock(inList=watch_22, replaceIndex=watch_23, replaceValue=watch_24)  # same code as code_block_7
sortByKey_2 = List.SortByKey(list=code_block_24.outListFlatten, keys=code_block_24.numIndexFlatten)
watch_25 = Watch(sortByKey_2.sortedList)

# group: element 별 Family Type 삽입 구간
identity_5 = Object.Identity(object=identity_3)
elementType_4 = Element.ElementType(element=identity_5@L1)
name_4 = Element.Name(element=elementType_4)
ofRepeatedItem_3 = List.OfRepeatedItem(item=name_4, amount=identity_4, lacing=Shortest)
watch_26 = Watch(watch_25)

watch_27 = Watch(ofRepeatedItem_3)

# group (continued): element 별 Family Type 삽입 구간
code_block_25 = CodeBlock(i=watch_27, j=watch_26) { i + "..." + j; }

identity_6 = Object.Identity(object=flatten_3)
identity_7 = Object.Identity(object=identity_6)

# group: element 별 WM code 삽입 구간
watch_28 = Watch(code_block_25)
watch_29 = Watch(identity_7)
code_block_26 = CodeBlock(i=watch_28, j=watch_29) { i + "..." + j; }
watch_30 = Watch(code_block_26)

# group: Data arrange for excel
flatten_7 = List.Flatten(list=watch_30)
code_block_27 = CodeBlock { "..."; }
split_2 = String.Split(str=flatten_7, separator0=code_block_27)
watch_31 = Watch(split_2)

# group: Excel Export
file_path_2 = Filename("C:\Users\HEC\Desktop\Wall Calculation sheet.xlsx")
code_block_28 = CodeBlock { "Wall Calculation"; }
code_block_29 = CodeBlock { 0; }
boolean = BoolSelector(true)
exportExcel = Data.ExportExcel(filePath=file_path_2, sheetName=code_block_28, startRow=code_block_29, startCol=code_block_29, data=watch_31, overWrite=boolean)  # frozen

code_block_30 = CodeBlock {  }
code_block_31 = CodeBlock {  }

# group: C. Category
code_block_32 = CodeBlock { "Category"; }
getParameterValueByName_5 = Element.GetParameterValueByName(element=all_elements_of_category, parameterName=code_block_32)

parameters_3 = Element.Parameters(element=all_elements_of_category)
python_script_export_excel_by = Python()  # "Python Script@Export Excel(By OpenpyXl)"; CPython3; frozen; unwired: IN[0]
# ---------- python_script_export_excel_by.python (145 lines) ----------
# Load the Python Standard and DesignScript Libraries
import sys
import os
#sys.path.append(r'C:\Users\HEC\AppData\Local\Programs\Python\Python39\Lib\site-packages')
#sys.path.append(r'C:\Users\pjmk0\AppData\Local\Programs\Python\Python39\Lib\site-packages')
sys.path.append(os.getenv('LOCALAPPDATA').replace('\\','\\\\') + r'\Programs\Python\Python39\Lib\site-packages')
import clr
clr.AddReference('ProtoGeometry')
from Autodesk.DesignScript.Geometry import *
from collections import Iterable

def iterable(obj):
    return isinstance(obj, Iterable)


# The inputs to this node will be stored as a list in the IN variables.
dataEnteringNode = IN
ListIn = IN[0]

# Place your code below this line
import datetime
import openpyxl
from openpyxl.styles import Border, Side, PatternFill, Font, GradientFill, Alignment

sample_items = ListIn


def write_to_file(filepath):
    wb = openpyxl.Workbook()
    for sheet in wb.sheetnames:
        wb.remove(wb[sheet])

    thin = Side(border_style="thin", color="000000")
    double = Side(border_style="double", color="000000")

    ws = wb.create_sheet(title='Wall_Calc_instance', index=0)

    ws.merge_cells('A1:L1')
    ws['A1'] = 'HEC Bidding Calculation Sheet'
    cell = ws['A1']
    cell.font = openpyxl.styles.Font(color='000000', size=20)
    cell.fill = openpyxl.styles.fills.PatternFill(patternType='solid',
                                                  fgColor=openpyxl.styles.colors.Color(rgb='fff3b0'))

    ws['A2'] = 'Item Number'
    ws['A2'].font = openpyxl.styles.Font(b=True, color='000000', size=12)
    ws['B2'] = 'Member Name'
    ws['B2'].font = openpyxl.styles.Font(b=True, color='000000', size=12)
    ws['C2'] = 'Category'
    ws['C2'].font = openpyxl.styles.Font(b=True, color='000000', size=12)
    ws['D2'] = 'Family Type'
    ws['D2'].font = openpyxl.styles.Font(b=True, color='000000', size=12)
    ws['E2'] = 'WorkMaster Code'
    ws['E2'].font = openpyxl.styles.Font(b=True, color='000000', size=12)
    ws['F2'] = 'WorkMaster Description'
    ws['F2'].font = openpyxl.styles.Font(b=True, color='000000', size=12)
    ws['G2'] = 'Unit'
    ws['G2'].font = openpyxl.styles.Font(b=True, color='000000', size=12)
    ws['H2'] = '계수'
    ws['H2'].font = openpyxl.styles.Font(b=True, color='000000', size=12)
    ws['I2'] = '계산 참조값'
    ws['I2'].font = openpyxl.styles.Font(b=True, color='000000', size=12)
    ws['J2'] = 'Quantities'
    ws['J2'].font = openpyxl.styles.Font(b=True, color='000000', size=12)
    ws['K2'] = 'Unit Price'
    ws['K2'].font = openpyxl.styles.Font(b=True, color='000000', size=12)
    ws['L2'] = 'Total Price'
    ws['L2'].font = openpyxl.styles.Font(b=True, color='000000', size=12)


## 칼럼별 너비 조정 구간
#    for col in range(ws.max_column):
#        ws.column_dimensions[chr(ord('A') + col)].width = 15
    ws.column_dimensions['A'].width = 15
    ws.column_dimensions['B'].width = 25
    ws.column_dimensions['C'].width = 12
    ws.column_dimensions['D'].width = 20
    ws.column_dimensions['E'].width = 20
    ws.column_dimensions['F'].width = 52
    ws.column_dimensions['G'].width = 9
    #ws.column_dimensions['H'].width = 9
    ws.column_dimensions['H'].hidden = True
    #ws.column_dimensions['I'].width = 12
    ws.column_dimensions['I'].hidden = True
    ws.column_dimensions['J'].width = 12
    ws.column_dimensions['K'].width = 12
    ws.column_dimensions['L'].width = 12

###
    start_row = 3
    for (row, item) in enumerate(sample_items, start_row):
        cell = ws.cell(row=row, column=1, value=row - 2)
        cell.alignment = openpyxl.styles.Alignment(horizontal='center', vertical='center')

#        cell = ws.cell(row=row, column=2, value=item[0])
#        cell.number_format = openpyxl.styles.numbers.FORMAT_DATE_YYYYMMDD2  # 'yyyy-mm-dd'
        ws.cell(row=row, column=2, value=item[0]) ## Room Name 칼럼

        ws.cell(row=row, column=3, value=item[1]) ## Department 칼럼
        
        ws.cell(row=row, column=4, value=item[2]) ## Interior Finish Type 칼럼
        
        ws.cell(row=row, column=5, value=item[3]) ## WorkMaster Code 칼럼
        
        ws.cell(row=row, column=6, value=item[4]) ## WorkMaster Description 칼럼
        
        ws.cell(row=row, column=7, value=item[5]) ## Unit 칼럼

        cell = ws.cell(row=row, column=8, value=item[6]) ## 계수 칼럼
        cell.number_format = openpyxl.styles.numbers.builtin_format_code(3)  # '#,##0'
        
        cell = ws.cell(row=row, column=9, value=item[7]) ## 계산 참조값 칼럼
        cell.number_format = openpyxl.styles.numbers.builtin_format_code(3)  # '#,##0'
        
        cell = ws.cell(row=row, column=10, value=item[8]) ## Quantities 칼럼
        cell.number_format = openpyxl.styles.numbers.builtin_format_code(3)  # '#,##0'
        cell.font = openpyxl.styles.Font(b=True, color='000000', size=11)

        cell = ws.cell(row=row, column=12, value='= J{current_row}*K{current_row}'.format(current_row=cell.row))
        cell.number_format = '#,##0'

#        cell = ws.cell(row=row, column=6, value='= D{current_row} * E{current_row}'.format(current_row=cell.row))
#        cell.number_format = openpyxl.styles.numbers.builtin_format_code(3)

    total_row = ws.max_row + 1
    if total_row > start_row:
        cell1 = ws.cell(row=total_row, column=11, value='Total')
        cell1.font = openpyxl.styles.Font(b=True, color='000000', size=15)
        
        cell2 = ws.cell(row=total_row, column=12, value='= SUM(L{}:L{})'.format(start_row, total_row - 1))
        cell2.number_format = openpyxl.styles.numbers.builtin_format_code(3)
        cell2.border = Border(top=double, left=double, right=double, bottom=double)
        cell2.font = openpyxl.styles.Font(b=True, color='ff03ce', size=15)
    

    wb.save(filepath)
    wb.close()


##if __name__ == '__main__':
#write_to_file('C:\\Users\\pjmk0\\AppData\\Roaming\\test.xlsx')
write_to_file(os.getenv('APPDATA').replace('\\','\\\\') + r'\HecBiddingCalcSheet1.xlsx')

# Assign your output to the OUT variable.
OUT = os.getenv('APPDATA')
# ----------------------------------------

# group: 사용된 패밀리 타입에서 세부코드가 기입된 Row 열 번호 추출
string_from_object_2 = FromObject(obj=replaceItemAtIndex)
code_block_33 = CodeBlock { "000"; }
contains_2 = String.Contains(str=string_from_object_2@L2, searchFor=code_block_33, lacing=CrossProduct)
code_block_34 = CodeBlock { true; }
allIndicesOf_4 = List.AllIndicesOf(list=contains_2@L2, item=code_block_34)
watch_32 = Watch(allIndicesOf_4)

# group: WM code 추출
identity_8 = Object.Identity(object=identity)
code_block_35 = CodeBlock(i=identity_8) { i[3]; }
watch_33 = Watch(code_block_35)
getItemAtIndex_4 = List.GetItemAtIndex(list=identity_8, index=watch_32@L2)
watch_34 = Watch(getItemAtIndex_4)
code_block_36 = CodeBlock { 2; }
getItemAtIndex_5 = List.GetItemAtIndex(list=watch_34@@L2, index=code_block_36)
watch_35 = Watch(getItemAtIndex_5)
code_block_37 = CodeBlock { 3; }
getItemAtIndex_6 = List.GetItemAtIndex(list=watch_34@@L2, index=code_block_37)
watch_36 = Watch(getItemAtIndex_6)
code_block_38 = CodeBlock { 4; }
getItemAtIndex_7 = List.GetItemAtIndex(list=watch_34@@L2, index=code_block_38)
watch_37 = Watch(getItemAtIndex_7)
watch_38 = Watch(replaceItemAtIndex)
code_block_39 = CodeBlock { 0; }
getItemAtIndex_8 = List.GetItemAtIndex(list=watch_34@@L2, index=code_block_39)
watch_39 = Watch(getItemAtIndex_8)
getItemAtIndex_9 = List.GetItemAtIndex(list=watch_38@L2, index=watch_32@L2)
watch_40 = Watch(getItemAtIndex_9)
code_block_40 = CodeBlock(i=watch_39, j=watch_40) { i + "-" + j; }

code_block_41 = CodeBlock { "Area"; }
getParameterValueByName_6 = Element.GetParameterValueByName(parameterName=code_block_41)  # unwired: element

# group: 함수목록 테스트
code_block_42 = CodeBlock()
# ---------- code_block_42.designscript (5 lines) ----------
[
"0",
"1",
"2"
];
# ----------------------------------------
code_block_43 = CodeBlock(a=getParameterValueByName_6, b=getParameterValueByName_6, c=getParameterValueByName_6) { [a,b,c]; }
map_2 = List.Map(list=code_block_42, function=code_block_43)
code_block_44 = CodeBlock { "-"; }
split_3 = String.Split(separator0=code_block_44)  # unwired: str
byKeysValues_3 = DesignScript.Builtin.Dictionary.ByKeysValues(keys=code_block_42, values=code_block_43)
valueAtKey = DesignScript.Builtin.Dictionary.ValueAtKey(dictionary=byKeysValues_3, key=code_block_42)
map_3 = List.Map(list=code_block_42, function=valueAtKey)
code_block_45 = CodeBlock { 0; }
code_block_46 = CodeBlock { 5; }
remove = String.Remove(startIndex=code_block_45, count=code_block_46)  # unwired: string
code_block_47 = CodeBlock { 0..10; }

watch_41 = Watch(all_elements_of_category)

# group: D. Family Type
elementType_5 = Element.ElementType(element=all_elements_of_category)
name_5 = Element.Name(element=elementType_5)

watch_42 = Watch(name_5)
laceShortest = List.LaceShortest(combineFunction=valueAtKey)  # unwired: list0, list1
map_4 = List.Map(function=laceShortest)  # unwired: list
code_block_48 = CodeBlock {  }
code_block_49 = CodeBlock {  }
code_block_50 = CodeBlock { t1 = [1, 2, 3]; t2 = List.Flatten(t1, -1); }

# group: 함수목록
code_block_51 = CodeBlock {  }
code_block_52 = CodeBlock {  }

getMaterials_3 = Element.GetMaterials(element=all_elements_of_category)
parameters_4 = Element.Parameters(element=getMaterials_3)
code_block_53 = CodeBlock { "d8450ee6-31bf-3463-a189-4fd1ad506668"; }
findByGuid = archilab.Revit.Elements.Schema.FindByGuid(guid=code_block_53)
code_block_54 = CodeBlock { 1; }
flatten_8 = List.Flatten(amt=code_block_54)  # unwired: list

# group: material inform from modeling <per element>
getMaterials_4 = Element.GetMaterials(element=all_elements_of_category)
name_6 = Element.Name(element=getMaterials_4)
code_block_55 = CodeBlock { "_"; }
split_4 = String.Split(str=name_6, separator0=code_block_55)
firstItem_2 = List.FirstItem(list=split_4@L2)
count_5 = List.Count(list=getMaterials_4@L2)
chop = List.Chop(list=firstItem_2, lengths=count_5)

# group: Wall Type: WM Code 딕셔너리 생성(벽체 layer에 포함 되지 않은 WM code 까지 포함되어야함)
code_block_56 = CodeBlock { 3; }
getItemAtIndex_10 = List.GetItemAtIndex(list=watch_38@L2, index=code_block_56)
code_block_57 = CodeBlock { "_"; "-"; }
split_5 = String.Split(str=getItemAtIndex_10, separator0=code_block_57.out0, separator1=code_block_57.out1)
firstItem_3 = List.FirstItem(list=split_5@L2)
byKeysValues_4 = DesignScript.Builtin.Dictionary.ByKeysValues(keys=firstItem_3, values=code_block_40)
watch_43 = Watch(byKeysValues_4)

# group: material inform from excel sheet <per family type>
watch_44 = Watch(watch_43)

# group: material inform from excel sheet <per element>
keys = DesignScript.Builtin.Dictionary.Keys(dictionary=watch_44)
name_7 = Element.Name(element=elementType_5)
contains_3 = String.Contains(str=name_7, searchFor=keys, lacing=CrossProduct)
code_block_58 = CodeBlock { true; }
allIndicesOf_5 = List.AllIndicesOf(list=contains_3@L2, item=code_block_58)
flatten_9 = List.Flatten(list=allIndicesOf_5)
getItemAtIndex_11 = List.GetItemAtIndex(list=keys, index=flatten_9)
valueAtKey_2 = DesignScript.Builtin.Dictionary.ValueAtKey(dictionary=watch_44, key=getItemAtIndex_11)

# group: 합집합
add = _ + _  # unwired: x, y
code_block_59 = CodeBlock { "..."; }
add_2 = chop@L2 + code_block_59
combine = List.Combine(combineFunction=add, list0=add_2, list1=valueAtKey_2)
isNull_2 = Object.IsNull(object=combine)
anyTrue = List.AnyTrue(list=isNull_2@L2)
code_block_60 = CodeBlock { true; }
allIndicesOf_6 = List.AllIndicesOf(list=anyTrue, item=code_block_60)
removeItemAtIndex = List.RemoveItemAtIndex(list=combine, indices=allIndicesOf_6)
code_block_61 = CodeBlock { "..."; }
split_6 = String.Split(str=removeItemAtIndex, separator0=code_block_61)
code_block_62 = CodeBlock { 1; }
flatten_10 = List.Flatten(list=split_6@L3, amt=code_block_62)

# group: 중복제거
uniqueItems_4 = List.UniqueItems(list=flatten_10@L2)

# group: 인덱스-엘리먼트, 인덱스-WM code 딕셔너리 형성
count_6 = List.Count(list=watch_41)
code_block_63 = CodeBlock(j=count_6) { 0..(j-1); }
string_from_object_3 = FromObject(object=code_block_63)
byKeysValues_5 = DesignScript.Builtin.Dictionary.ByKeysValues(keys=string_from_object_3, values=watch_41)
watch_45 = Watch(byKeysValues_5)
byKeysValues_6 = DesignScript.Builtin.Dictionary.ByKeysValues(keys=string_from_object_3, values=uniqueItems_4)
watch_46 = Watch(byKeysValues_6)

byKeysValues_7 = DesignScript.Builtin.Dictionary.ByKeysValues(keys=string_from_object_3, values=watch_42)
watch_47 = Watch(byKeysValues_7)
valueAtKey_3 = DesignScript.Builtin.Dictionary.ValueAtKey(dictionary=watch_47, key=string_from_object_3)
valueAtKey_4 = DesignScript.Builtin.Dictionary.ValueAtKey(dictionary=watch_45, key=string_from_object_3)
laceShortest_2 = List.LaceShortest(combineFunction=laceShortest, list0=valueAtKey_4, list1=valueAtKey)
parameters_5 = Element.Parameters(element=valueAtKey_4)
valueAtKey_5 = DesignScript.Builtin.Dictionary.ValueAtKey(dictionary=watch_46, key=string_from_object_3)

# group: 산출값 List 초기화
code_block_64 = CodeBlock { "initialValue"; }
count_7 = List.Count(list=valueAtKey_5@L2)
ofRepeatedItem_4 = List.OfRepeatedItem(item=code_block_64, amount=count_7)

# group: 산출대상 WM 인덱스 넘버 추출
code_block_65 = CodeBlock { "A03AD032-00007"; }
# note: element 인덱스
allIndicesOf_7 = List.AllIndicesOf(list=valueAtKey_5@L2, item=code_block_65)
contains_4 = List.Contains(list=valueAtKey_5@L2, item=code_block_65)
code_block_66 = CodeBlock { true; }
# note: element 별 WM 인덱스
allIndicesOf_8 = List.AllIndicesOf(list=contains_4, item=code_block_66)

# group: Volume 값 추출
code_block_67 = CodeBlock { "Volume"; }
getParameterValueByName_7 = Element.GetParameterValueByName(element=valueAtKey_4, parameterName=code_block_67)
getItemAtIndex_12 = List.GetItemAtIndex(list=getParameterValueByName_7, index=allIndicesOf_8)
code_block_68 = CodeBlock { 2; }
round = Math.Round(number=getItemAtIndex_12, digits=code_block_68)

replaceItemAtIndex_2 = List.ReplaceItemAtIndex(list=ofRepeatedItem_4@L2, index=allIndicesOf_7, item=round, lacing=Longest)
isEmpty = List.IsEmpty(list=replaceItemAtIndex_2@L3)
code_block_69 = CodeBlock { true; }
allIndicesOf_9 = List.AllIndicesOf(list=isEmpty, item=code_block_69)
getItemAtIndex_13 = List.GetItemAtIndex(list=ofRepeatedItem_4, index=allIndicesOf_9)
replaceItemAtIndex_3 = List.ReplaceItemAtIndex(index=allIndicesOf_9@L1, item=getItemAtIndex_13@L1)  # unwired: list
map_5 = List.Map(list=replaceItemAtIndex_2, function=replaceItemAtIndex_3)
watch_48 = Watch(map_5)
combine_2 = List.Combine(combineFunction=replaceItemAtIndex_3, list0=replaceItemAtIndex_2, list1=getItemAtIndex_13)
