# Dynamo graph Str Framing Calculator_HEC(0713).dyn (Dynamo 2.10.1.3976)

# group: All Elements of Category -Str Framing
categories = Categories("OST_StructuralFraming")
all_elements_of_category = ElementsOfCategory(Category=categories)

# group: Concrete - Steel 부재 구분
watch = Watch(all_elements_of_category)
elementType = Element.ElementType(element=watch)
familyName = ElementType.FamilyName(elementType=elementType)
watch_2 = Watch(familyName)
string_from_object = FromObject(object=watch_2)
code_block = CodeBlock { "Concrete"; }
contains = String.Contains(str=string_from_object, searchFor=code_block)
filterByBoolMask = List.FilterByBoolMask(list=all_elements_of_category, mask=contains)

# group: Steel Family
watch_3 = Watch(filterByBoolMask.out)
name = FamilyType.Name(familyType=watch_3)
string_from_object_2 = FromObject(object=name)
code_block_2 = CodeBlock { "BM"; }
contains_2 = String.Contains(str=string_from_object_2, searchFor=code_block_2)
filterByBoolMask_2 = List.FilterByBoolMask(list=watch_3, mask=contains_2)
watch_4 = Watch(filterByBoolMask_2.in)
# note: Preview
geometry = Element.Geometry(element=watch_4)
watch_5 = Watch(geometry)
watch_6 = Watch(filterByBoolMask_2.out)

# group: Built-up 자재 구분 추후 작성
code_block_3 = CodeBlock { UW; }  # unwired: UW
code_block_4 = CodeBlock { 90; 30; }
# note: Built up 제외외
ge = code_block_3 >= code_block_4.out0
lt = code_block_3 < code_block_4.out1
ge_2 = code_block_3 >= code_block_4.out1
# note: Built up 자제만
watch_7 = Watch(ge_2)
le = watch_7 <= code_block_4.out0

watch_8 = Watch(watch_4)

# group: Mass per Unit Length (kg/m) 추출
elementType_2 = Element.ElementType(element=watch_8)
list_create = List.Create(item0=elementType_2)
code_block_5 = CodeBlock { "Mass per Unit Length"; }
getParameterValueByName = Element.GetParameterValueByName(element=elementType_2, parameterName=code_block_5)

# group: Length(mm) 추출
code_block_6 = CodeBlock { "Length"; }
getParameterValueByName_2 = Element.GetParameterValueByName(element=watch_8, parameterName=code_block_6)

# group: Steel 중량 산출 (Ton) Unit Weight x Length
code_block_7 = CodeBlock(i=getParameterValueByName_2) { i[]*0.001; }
# note: 단위변환 kg -> ton
# note: 단위변환 mm -> m
code_block_8 = CodeBlock(i=getParameterValueByName) { i[]*0.001; }
mul = code_block_7 * code_block_8

code_block_9 = CodeBlock {  }
code_block_10 = CodeBlock {  }

# group: preview
geometry_2 = Element.Geometry(element=all_elements_of_category)

# group: Concrete Family
watch_9 = Watch(filterByBoolMask.in)
# note: Preview
geometry_3 = Element.Geometry(element=watch_9)
watch_10 = Watch(geometry_3)

# group: UG/AG 구분
string_from_object_3 = FromObject(object=watch_9)
code_block_11 = CodeBlock { "UG"; }
contains_3 = String.Contains(str=string_from_object_3, searchFor=code_block_11)
filterByBoolMask_3 = List.FilterByBoolMask(list=watch_9, mask=contains_3)

# group: UG Concrete Family
watch_11 = Watch(filterByBoolMask_3.in)
# note: Preview
geometry_4 = Element.Geometry(element=watch_11)

# group: 측면 추출 (UG)
watch_12 = Watch(watch_11)
faces = Element.Faces(element=watch_12)
code_block_12 = CodeBlock { 0.5; }
normalAtParameter = Surface.NormalAtParameter(surface=faces, u=code_block_12, v=code_block_12)
Z = Vector.Z(vector=normalAtParameter)
round = Math.Round(number=Z)
code_block_13 = CodeBlock(a=round) { a==0; a>0; a<0; a==-1; }
filterByBoolMask_4 = List.FilterByBoolMask(list=faces, mask=code_block_13.out0)
watch_13 = Watch(filterByBoolMask_4.in)
flatten = List.Flatten(list=faces)

# group: UG 측면 Surface Area (Concrete) - m2
watch_14 = Watch(watch_13)
area = Surface.Area(surface=watch_14)
# note: 단위조정(mm2 -> m2)
code_block_14 = CodeBlock(i=area) { i/1000000; }
sum = Math.Sum(values=code_block_14@L2)

# group: UG Volume (Concrete) - m3
watch_15 = Watch(watch_12)
solids = Element.Solids(element=watch_15)
volume = Solid.Volume(solid=solids)
# note: 단위조정(mm3 -> m3)
code_block_15 = CodeBlock(i=volume) { i/1000000000; }
watch_16 = Watch(code_block_15)

# group: AG Concrete Family
watch_17 = Watch(filterByBoolMask_3.out)
# note: Preview
geometry_5 = Element.Geometry(element=watch_17)

# group: 측면 추출Preview
code_block_16 = CodeBlock(i=watch_13) { i[0]; }

# group: 측면, 하부면 추출(AG)
watch_18 = Watch(watch_17)
faces_2 = Element.Faces(element=watch_18)
flatten_2 = List.Flatten(list=faces_2)
code_block_17 = CodeBlock { 0.5; }
normalAtParameter_2 = Surface.NormalAtParameter(surface=faces_2, u=code_block_17, v=code_block_17)
Z_2 = Vector.Z(vector=normalAtParameter_2)
round_2 = Math.Round(number=Z_2)
code_block_18 = CodeBlock(a=round_2) { a<=0; a>0; a<0; a==-1; }
filterByBoolMask_5 = List.FilterByBoolMask(list=faces_2, mask=code_block_18.out0)
watch_19 = Watch(filterByBoolMask_5.in)

code_block_19 = CodeBlock(i=watch_19) { i[0]; }

# group: AG 측면,하부면 Surface Area (Concrete) - m2
watch_20 = Watch(watch_19)
area_2 = Surface.Area(surface=watch_20)
# note: 단위조정(mm2 -> m2)
code_block_20 = CodeBlock(i=area_2) { i/1000000; }
sum_2 = Math.Sum(values=code_block_20@L2)

# group: AG Volume (Concrete) - m3
watch_21 = Watch(watch_18)
solids_2 = Element.Solids(element=watch_21)
volume_2 = Solid.Volume(solid=solids_2)
# note: 단위조정(mm3 -> m3)
code_block_21 = CodeBlock(i=volume_2) { i/1000000000; }
watch_22 = Watch(code_block_21)

# group: 예시) Family
watch_23 = Watch(filterByBoolMask.out)
name_2 = FamilyType.Name(familyType=watch_23)
uniqueItems = List.UniqueItems(list=name_2)
code_block_22 = CodeBlock(i=uniqueItems) { i[1]; }
contains_4 = String.Contains(str=name_2, searchFor=code_block_22)
filterByBoolMask_6 = List.FilterByBoolMask(list=watch_23, mask=contains_4)
watch_24 = Watch(filterByBoolMask_6.out)
watch_25 = Watch(filterByBoolMask_6.in)
# note: Preview
geometry_6 = Element.Geometry(element=watch_25)
watch_26 = Watch(geometry_6)

# group: Surface Area (m2/m) 추출
elementType_3 = Element.ElementType(element=watch_8)
list_create_2 = List.Create(item0=elementType_3)
code_block_23 = CodeBlock { "Surface Area"; }
getParameterValueByName_3 = Element.GetParameterValueByName(element=elementType_3, parameterName=code_block_23)

# group: Steel Surface Area 물량 (m2) Unit Surface Area x Length
# note: 단위변환 mm -> m
code_block_24 = CodeBlock(i=getParameterValueByName_2) { i[]*0.001; }
mul_2 = code_block_24 * getParameterValueByName_3

watch_27 = Watch(watch_25)

# group: Mass per Unit Length (kg/m) 추출
elementType_4 = Element.ElementType(element=watch_27)
list_create_3 = List.Create(item0=elementType_4)
code_block_25 = CodeBlock { "Mass per Unit Length"; }
getParameterValueByName_4 = Element.GetParameterValueByName(element=elementType_4, parameterName=code_block_25)

# group: Surface Area (m2/m) 추출
elementType_5 = Element.ElementType(element=watch_27)
list_create_4 = List.Create(item0=elementType_5)
code_block_26 = CodeBlock { "Surface Area"; }
getParameterValueByName_5 = Element.GetParameterValueByName(element=elementType_5, parameterName=code_block_26)

# group: Length(mm) 추출
code_block_27 = CodeBlock { "Length"; }
getParameterValueByName_6 = Element.GetParameterValueByName(element=watch_27, parameterName=code_block_27)

# group: Steel Surface Area 물량 (m2) Unit Surface Area x Length
# note: 단위변환 mm -> m
code_block_28 = CodeBlock(i=getParameterValueByName_6) { i[]*0.001; }
mul_3 = code_block_28 * getParameterValueByName_5
watch_28 = Watch(mul_3)

name_3 = Element.Name(element=watch_27)
code_block_29 = CodeBlock(i=name_3) { i; }

# group: Steel 중량 산출 (Ton) Unit Weight x Length
code_block_30 = CodeBlock(i=getParameterValueByName_6) { i[]*0.001; }
# note: 단위변환 kg -> ton
# note: 단위변환 mm -> m
code_block_31 = CodeBlock(i=getParameterValueByName_4) { i[]*0.001; }
mul_4 = code_block_30 * code_block_31
watch_29 = Watch(mul_4)

code_block_32 = CodeBlock(a=code_block_29, b=watch_29) { a+"_"+b; }
watch_30 = Watch(code_block_32)

# group: Excel Import
file_path = Filename("..\BIM_물량집계 자동화 산출기준표_rC(20210713)_KCS.xlsx")
file_from_path = FileObject(path=file_path)
string_from_object_4 = FromObject(object=file_from_path)
code_block_33 = CodeBlock { "Scope_lv2(Str Framing)"; }
python_script_import_excel_by = Python(IN[0]=string_from_object_4, IN[1]=code_block_33)  # "Python Script@Import Excel(By OpenpyXl)"; CPython3
# ---------- python_script_import_excel_by.python (50 lines) ----------
# Load the Python Standard and DesignScript Libraries
import sys
import os
#sys.path.append(r'C:\Users\HEC\AppData\Local\Programs\Python\Python39\Lib\site-packages')
#sys.path.append(r'C:\Users\pjmk0\AppData\Local\Programs\Python\Python39\Lib\site-packages')
sys.path.append(os.getenv('LOCALAPPDATA').replace('\\','\\\\') + r'\Programs\Python\Python39\Lib\site-packages')
import clr
clr.AddReference('ProtoGeometry')
from Autodesk.DesignScript.Geometry import *
from collections import Iterable

def iterable(obj):
    return isinstance(obj, Iterable)


# The inputs to this node will be stored as a list in the IN variables.
dataEnteringNode = IN
PathIn = IN[0]
SheetNameIn = IN[1]

# Place your code below this line
import datetime
import openpyxl

path = (PathIn)
#path = (r'C:\Users\pjmk0\Downloads\MK\mQ\BIM_물량집계 자동화 산출기준표_rC(20210607)_mk_de.xlsx')

wb_obj = openpyxl.load_workbook(path, data_only=True)
sheet_obj = wb_obj.get_sheet_by_name(SheetNameIn)

m_row = sheet_obj.max_row
m_col = sheet_obj.max_column

listOut = []



for i in range(1, m_row +1):
    listTemp = []
    for j in range(1, m_col + 1):
        cell_obj = sheet_obj.cell(row=i, column=j)
        listTemp.append(cell_obj.value)
        if len(listTemp) == m_col:
            listOut.append(listTemp)
        


# Assign your output to the OUT variable.
OUT = listOut
#OUT = os.getenv('APPDATA')
# ----------------------------------------
code_block_34 = CodeBlock { false; }
importExcel = Data.ImportExcel(file=file_from_path, sheetName=code_block_33, showExcel=code_block_34)  # frozen

# group: Null값 처리
code_block_35 = CodeBlock { " "; }
isNull = Object.IsNull()  # unwired: object
replaceByCondition = Replace(item=python_script_import_excel_by, replaceWith=code_block_35, condition=isNull)

# group: Whole Data(Column direction)
transpose = List.Transpose(lists=replaceByCondition)
watch_31 = Watch(transpose)

# group: Whole Data(row direction)
watch_32 = Watch(replaceByCondition)

# group: Column Index Guide
code_block_36 = CodeBlock(i=watch_32) { i[3]; }
watch_33 = Watch(code_block_36)

# group: All Elements of Category
watch_all_elements_of_category = Watch(all_elements_of_category)  # "Watch@All Elements of Category - Str Framing"

# group: 모델링에 사용된 모든 패밀리타입 코드 추출
name_4 = Element.Name(element=watch_all_elements_of_category)
uniqueItems_2 = List.UniqueItems(list=name_4@L2)
flatten_3 = List.Flatten(list=uniqueItems_2)
watch_34 = Watch(flatten_3)
code_block_37 = CodeBlock { "_"; }
split = String.Split(str=watch_34, separator0=code_block_37)
firstItem = List.FirstItem(list=split@L2)

# group: 사용된 패밀리타입이 위치한 Column Index 추출
string_from_object_5 = FromObject(object=watch_33)
contains_5 = String.Contains(searchFor=firstItem, lacing=CrossProduct)  # unwired: str
map = List.Map(list=string_from_object_5, function=contains_5)
allFalse = List.AllFalse(list=map@L2)
code_block_38 = CodeBlock(i=allFalse) { i==false?true:false; }
code_block_39 = CodeBlock { true; }
allIndicesOf = List.AllIndicesOf(list=code_block_38, item=code_block_39)

# group: 사용된 패밀리타입 Column Data 추출
watch_35 = Watch(allIndicesOf)
getItemAtIndex = List.GetItemAtIndex(list=watch_31, index=watch_35)
code_block_40 = CodeBlock { 4; ""; }
# note: 불필요 정보 처리
replaceItemAtIndex = List.ReplaceItemAtIndex(list=getItemAtIndex@L2, index=code_block_40.out0, item=code_block_40.out1)
watch_36 = Watch(getItemAtIndex)

whole_data_row_direction = Object.Identity(object=watch_32)

# group: 사용된 패밀리 타입에서 세부코드가 기입된 Row 열 번호 추출
string_from_object_6 = FromObject(object=replaceItemAtIndex)
code_block_41 = CodeBlock { "000"; }
contains_6 = String.Contains(str=string_from_object_6@L2, searchFor=code_block_41, lacing=CrossProduct)
code_block_42 = CodeBlock { true; }
allIndicesOf_2 = List.AllIndicesOf(list=contains_6@L2, item=code_block_42)
watch_37 = Watch(allIndicesOf_2)

# group: WM code 추출
watch_38 = Watch(replaceItemAtIndex)
whole_data_row_direction_2 = Object.Identity(object=whole_data_row_direction)
getItemAtIndex_2 = List.GetItemAtIndex(list=whole_data_row_direction_2, index=watch_37@L2)
watch_39 = Watch(getItemAtIndex_2)
code_block_43 = CodeBlock { 3; }
getItemAtIndex_3 = List.GetItemAtIndex(list=watch_39@@L2, index=code_block_43)
watch_40 = Watch(getItemAtIndex_3)
code_block_44 = CodeBlock { 2; }
getItemAtIndex_4 = List.GetItemAtIndex(list=watch_39@@L2, index=code_block_44)
watch_41 = Watch(getItemAtIndex_4)
code_block_45 = CodeBlock(i=whole_data_row_direction_2) { i[3]; }
watch_42 = Watch(code_block_45)
code_block_46 = CodeBlock { 4; }
getItemAtIndex_5 = List.GetItemAtIndex(list=watch_39@@L2, index=code_block_46)
watch_43 = Watch(getItemAtIndex_5)
code_block_47 = CodeBlock { 0; }
getItemAtIndex_6 = List.GetItemAtIndex(list=watch_39@@L2, index=code_block_47)
watch_44 = Watch(getItemAtIndex_6)
getItemAtIndex_7 = List.GetItemAtIndex(list=watch_38@@L2, index=watch_37@L2)
watch_45 = Watch(getItemAtIndex_7)
code_block_48 = CodeBlock(i=watch_44, j=watch_45) { i + "-" + j; }

# group: Family Type: WM Code 딕셔너리 생성(모델링에 포함 되지 않은 WM code 까지 포함되어야함)
code_block_49 = CodeBlock { 3; }
getItemAtIndex_8 = List.GetItemAtIndex(list=watch_38@L2, index=code_block_49)
code_block_50 = CodeBlock { "_"; "-"; }
split_2 = String.Split(str=getItemAtIndex_8, separator0=code_block_50.out0, separator1=code_block_50.out1)
firstItem_2 = List.FirstItem(list=split_2@L2)
byKeysValues = DesignScript.Builtin.Dictionary.ByKeysValues(keys=firstItem_2)  # unwired: values
python_script = Python(IN[0]=firstItem_2)  # IronPython2
# ---------- python_script.python (22 lines) ----------
# Load the Python Standard and DesignScript Libraries
import sys
import clr
clr.AddReference('ProtoGeometry')
from Autodesk.DesignScript.Geometry import *

# The inputs to this node will be stored as a list in the IN variables.
dataEnteringNode = IN

# Place your code below this line
familyNameInput = IN[0]

listOut = []
for i in range(len(familyNameInput)):
	processedString = familyNameInput[i] + "." + str(i)
	listOut.append(processedString)




# Assign your output to the OUT variable.
OUT = listOut
# ----------------------------------------
byKeysValues_2 = DesignScript.Builtin.Dictionary.ByKeysValues(keys=python_script, values=code_block_48)
watch_46 = Watch(byKeysValues_2)

# group: D. Family Type
watch_all_elements_of_category_2 = Watch(watch_all_elements_of_category)  # "Watch@All Elements of Category - Str Framing"
name_5 = Element.Name(element=watch_all_elements_of_category_2)

# group: Row Index Guide
code_block_51 = CodeBlock(i=watch_31) { i[3]; }
watch_47 = Watch(code_block_51)

# group: C. Category
code_block_52 = CodeBlock { "Category"; }
getParameterValueByName_7 = Element.GetParameterValueByName(element=watch_all_elements_of_category, parameterName=code_block_52)

# group: material inform from excel sheet <per family type>
watch_48 = Watch(watch_46)

# group: material inform from excel sheet <per element>
name_6 = Element.Name(element=watch_all_elements_of_category_2)
keys = DesignScript.Builtin.Dictionary.Keys(dictionary=watch_48)
sort = List.Sort(list=keys)
code_block_53 = CodeBlock { "."; }
split_3 = String.Split(str=sort, separator0=code_block_53)
firstItem_3 = List.FirstItem(list=split_3@L2)
contains_7 = String.Contains(str=name_6, searchFor=firstItem_3, lacing=CrossProduct)
code_block_54 = CodeBlock { true; }
allIndicesOf_3 = List.AllIndicesOf(list=contains_7@L2, item=code_block_54)
firstItem_4 = List.FirstItem(list=allIndicesOf_3@L2)
getItemAtIndex_9 = List.GetItemAtIndex(list=sort, index=firstItem_4)
valueAtKey = DesignScript.Builtin.Dictionary.ValueAtKey(dictionary=watch_48, key=getItemAtIndex_9)

# group: Excel 미포함 객체 제외
anyTrue = List.AnyTrue(list=contains_7@L2)
filterByBoolMask_7 = List.FilterByBoolMask(list=watch_all_elements_of_category_2, mask=anyTrue)

# group: Element (Excel 미포함 객체 제외)
watch_workmaster_미포함_객체_제외_임시 = Watch(filterByBoolMask_7.in)

# group: material inform from modeling <per element>
getMaterials = Element.GetMaterials(element=filterByBoolMask_7.in)
name_7 = Element.Name(element=getMaterials)
code_block_55 = CodeBlock { "_"; }
split_4 = String.Split(str=name_7, separator0=code_block_55)
firstItem_5 = List.FirstItem(list=split_4@L2)
count = List.Count(list=getMaterials@L2)
chop = List.Chop(list=firstItem_5, lengths=count)

# group: 합집합
list_create_5 = List.Create(item0=chop, item1=valueAtKey)
transpose_2 = List.Transpose(lists=list_create_5)
watch_49 = Watch(transpose_2)
code_block_56 = CodeBlock { 1; }
flatten_4 = List.Flatten(list=watch_49@L3, amt=code_block_56)

# group: WM 중복제거
uniqueItems_3 = List.UniqueItems(list=flatten_4@L2)

# group: Total material index
watch_wm_중복제거 = Watch(uniqueItems_3)
flatten_5 = List.Flatten(list=watch_wm_중복제거)

# group: 각 element 별 material 개수로 복제
ofRepeatedItem = List.OfRepeatedItem()  # unwired: item, amount
count_2 = List.Count(list=watch_wm_중복제거@L2)
laceShortest = List.LaceShortest(combineFunction=ofRepeatedItem, list0=watch_workmaster_미포함_객체_제외_임시, list1=count_2)
watch_50 = Watch(laceShortest)
flatten_6 = List.Flatten(list=watch_50)

# group: Element Filter 적용구간 - <element> : Steel
watch_각_element별_material_개수로 = Watch(flatten_6)  # "Watch@각 element별 material 개수로 리스트 복제"
elementType_6 = Element.ElementType(element=watch_각_element별_material_개수로)
familyName_2 = ElementType.FamilyName(elementType=elementType_6)
code_block_57 = CodeBlock { "Steel"; }
contains_8 = String.Contains(str=familyName_2, searchFor=code_block_57)
count_3 = List.Count(list=contains_8)
filterByBoolMask_8 = List.FilterByBoolMask(list=watch_각_element별_material_개수로, mask=contains_8)
watch_51 = Watch(filterByBoolMask_8.in)

# group: Element Filter 적용구간 - <element> : Concrete UG
watch_각_element별_material_개수로_2 = Watch(flatten_6)  # "Watch@각 element별 material 개수로 리스트 복제"
elementType_7 = Element.ElementType(element=watch_각_element별_material_개수로_2)
string_from_object_7 = FromObject(object=elementType_7)
code_block_58 = CodeBlock()
# ---------- code_block_58.designscript (5 lines) ----------
[
"Concrete"
,
"UG"
];
# ----------------------------------------
contains_9 = String.Contains(str=string_from_object_7@L1, searchFor=code_block_58)
allTrue = List.AllTrue(list=contains_9@L2)
filterByBoolMask_9 = List.FilterByBoolMask(list=watch_각_element별_material_개수로_2, mask=allTrue)
count_4 = List.Count(list=contains_9)

# group: Element Filter 적용구간 - <material> : Concrete UG
watch_total_material_index = Watch(flatten_5)
filterByBoolMask_10 = List.FilterByBoolMask(list=watch_total_material_index, mask=allTrue)

# group: Element Filter 적용구간 - <element> : Concrete AG
watch_각_element별_material_개수로_3 = Watch(flatten_6)  # "Watch@각 element별 material 개수로 리스트 복제"
elementType_8 = Element.ElementType(element=watch_각_element별_material_개수로_3)
string_from_object_8 = FromObject(object=elementType_8)
code_block_59 = CodeBlock()
# ---------- code_block_59.designscript (5 lines) ----------
[
"Concrete"
,
"AG"
];
# ----------------------------------------
contains_10 = String.Contains(str=string_from_object_8@L1, searchFor=code_block_59)
allTrue_2 = List.AllTrue(list=contains_10@L2)
filterByBoolMask_11 = List.FilterByBoolMask(list=watch_각_element별_material_개수로_3, mask=allTrue_2)
count_5 = List.Count(list=contains_10)

# group: Element Filter 적용구간 - <material> : Concrete AG
watch_total_material_index_2 = Watch(flatten_5)
filterByBoolMask_12 = List.FilterByBoolMask(list=watch_total_material_index_2, mask=allTrue_2)

# group: Preview
geometry_7 = Element.Geometry(element=filterByBoolMask_8.in)

# group: 함수 1 - Steel 중량 산출 (Ton) [Cat.2] Unit Weight x Length
elementType_9 = Element.ElementType(element=watch_51)
list_create_6 = List.Create(item0=elementType_9)
# note: target WM 입력부
code_block_60 = CodeBlock()
# ---------- code_block_60.designscript (15 lines) ----------
[
"S01AA001",
"S01AA002",
"S01AA003",
"S01AA004",
"S01AA005",
"S01AA006",
"S01AA007",
"S01AA008",
"S03AA027",
"S03AA028",
"S03AA029",
"S03AA007",
"S03AA008"
];
# ----------------------------------------
code_block_61 = CodeBlock { "Length"; }
# note: Length 추출
getParameterValueByName_8 = Element.GetParameterValueByName(element=watch_51, parameterName=code_block_61)
code_block_62 = CodeBlock(i=getParameterValueByName_8) { i[]*0.001; }
code_block_63 = CodeBlock { "Mass per Unit Length"; }
# note: Mass per Unit Length (kg/m) 추출
getParameterValueByName_9 = Element.GetParameterValueByName(element=elementType_9, parameterName=code_block_63)
# note: 단위변환 kg -> ton
# note: 단위변환 mm -> m
code_block_64 = CodeBlock(i=getParameterValueByName_9) { i[]*0.001; }
mul_5 = code_block_62 * code_block_64

# group: 함수 2 - Steel Surface Area 물량 (m2) Unit Surface Area x Length
elementType_10 = Element.ElementType(element=watch_51)
list_create_7 = List.Create(item0=elementType_10)
# note: target WM 입력부
code_block_65 = CodeBlock()
# ---------- code_block_65.designscript (8 lines) ----------
[
"S01AA010",
"S03AE015",
"F01AA000",
"F01AB000",
"F01AC000",
"F01AD000"
];
# ----------------------------------------
code_block_66 = CodeBlock { "Length"; }
# note: Length 추출
getParameterValueByName_10 = Element.GetParameterValueByName(element=watch_51, parameterName=code_block_66)
code_block_67 = CodeBlock(i=getParameterValueByName_10) { i[]*0.001; }
code_block_68 = CodeBlock { "Surface Area"; }
# note: Unit Surface Area (m2/m) 추출
getParameterValueByName_11 = Element.GetParameterValueByName(element=elementType_10, parameterName=code_block_68)
# note: 단위변환 mm -> m
code_block_69 = CodeBlock(i=getParameterValueByName_11) { i[]*0.001; }
mul_6 = code_block_67 * code_block_69

# group: Element Filter 적용구간 - <material> : Steel
watch_total_material_index_3 = Watch(flatten_5)
filterByBoolMask_13 = List.FilterByBoolMask(list=watch_total_material_index_3, mask=contains_8)
watch_52 = Watch(filterByBoolMask_13.in)

# group: target WM 적용 함수 - element 매칭 구간
watch_material_index = Watch(watch_52)
# note: 해당 함수의 target materials index 검색
contains_11 = String.Contains(str=watch_material_index@L1, searchFor=code_block_60)
anyTrue_2 = List.AnyTrue(list=contains_11@L2)
boolean = BoolSelector(true)
# note: getting index of element which has target materials
allIndicesOf_4 = List.AllIndicesOf(list=anyTrue_2@L2, item=boolean)
flatten_7 = List.Flatten(list=allIndicesOf_4)
getItemAtIndex_10 = List.GetItemAtIndex(list=watch_51, index=flatten_7)
watch_53 = Watch(getItemAtIndex_10)
getItemAtIndex_11 = List.GetItemAtIndex(list=mul_5, index=flatten_7)
watch_54 = Watch(getItemAtIndex_11)

# group: FamilyName, WorkMasterCode, Quantities, Unit 결합구간
name_8 = Element.Name(element=watch_53)
watch_material_index_2 = Watch(watch_material_index)
getItemAtIndex_12 = List.GetItemAtIndex(list=watch_material_index_2, index=flatten_7)
flatten_8 = List.Flatten(list=watch_54)
watch_55 = Watch(flatten_8)
code_block_70 = CodeBlock { "Ton"; }
code_block_71 = CodeBlock(familyName=name_8, workmasterCode=getItemAtIndex_12, quantities=watch_55, unit=code_block_70) { familyName +"..."+ workmasterCode +"..."+ quantities +"..."+ unit; }

# group: target WM 적용 함수 - element 매칭 구간
watch_material_index_3 = Watch(watch_52)
# note: 해당 함수의 target materials index 검색
contains_12 = String.Contains(str=watch_material_index_3@L1, searchFor=code_block_65)
anyTrue_3 = List.AnyTrue(list=contains_12@L2)
boolean_2 = BoolSelector(true)
# note: getting index of element which has target materials
allIndicesOf_5 = List.AllIndicesOf(list=anyTrue_3@L2, item=boolean_2)
flatten_9 = List.Flatten(list=allIndicesOf_5)
getItemAtIndex_13 = List.GetItemAtIndex(list=watch_51, index=flatten_9)
watch_56 = Watch(getItemAtIndex_13)
getItemAtIndex_14 = List.GetItemAtIndex(list=mul_6, index=flatten_9)
watch_57 = Watch(getItemAtIndex_14)

# group: FamilyName, WorkMasterCode, Quantities, Unit 결합구간
name_9 = Element.Name(element=watch_56)
watch_material_index_4 = Watch(watch_material_index_3)
getItemAtIndex_15 = List.GetItemAtIndex(list=watch_material_index_4, index=flatten_9)
flatten_10 = List.Flatten(list=watch_57)
watch_58 = Watch(flatten_10)
code_block_72 = CodeBlock { "M2"; }
code_block_73 = CodeBlock(familyName=name_9, workmasterCode=getItemAtIndex_15, quantities=watch_58, unit=code_block_72) { familyName +"..."+ workmasterCode +"..."+ quantities +"..."+ unit; }

# group: DATA 전처리
join = List.Join(list0=code_block_71, list1=code_block_73)
code_block_74 = CodeBlock { "..."; }
split_5 = String.Split(str=join, separator0=code_block_74)
watch_59 = Watch(split_5)

# group: Export Excel(By OpenpyXl)
python_script_export_excel_by = Python(IN[0]=watch_59)  # "Python Script@Export Excel(By OpenpyXl)"; CPython3; frozen
# ---------- python_script_export_excel_by.python (151 lines) ----------
# Load the Python Standard and DesignScript Libraries
import sys
import os
#sys.path.append(r'C:\Users\HEC\AppData\Local\Programs\Python\Python39\Lib\site-packages')
#sys.path.append(r'C:\Users\pjmk0\AppData\Local\Programs\Python\Python39\Lib\site-packages')
sys.path.append(os.getenv('LOCALAPPDATA').replace('\\','\\\\') + r'\Programs\Python\Python39\Lib\site-packages')
import clr
clr.AddReference('ProtoGeometry')
from Autodesk.DesignScript.Geometry import *
from collections import Iterable

def iterable(obj):
    return isinstance(obj, Iterable)


# The inputs to this node will be stored as a list in the IN variables.
dataEnteringNode = IN
ListIn = IN[0]

# Place your code below this line
import datetime
from datetime import date, timedelta
Today = date.today()
import openpyxl
from openpyxl.styles import Border, Side, PatternFill, Font, GradientFill, Alignment, Color, numbers

sample_items = ListIn


def write_to_file(filepath):
    wb = openpyxl.Workbook()
    for sheet in wb.sheetnames:
        wb.remove(wb[sheet])

    thin = Side(border_style="thin", color="000000")
    double = Side(border_style="double", color="000000")

    ws = wb.create_sheet(title='Str Framing_Calc_instance', index=0)

    ws.merge_cells('A1:L1')
    ws['A1'] = 'HEC Structural Framing Category Calculation Sheet'
    cell = ws['A1']
    cell.font = openpyxl.styles.Font(color='000000', size=20)
    cell.fill = openpyxl.styles.fills.PatternFill(patternType='solid',
                                                  fgColor=openpyxl.styles.colors.Color(rgb='fff3b0'))

    ws['A2'] = 'Item Number'
    ws['A2'].font = openpyxl.styles.Font(b=True, color='000000', size=12)
    #ws['B2'] = 'Member Name'
    #ws['B2'].font = openpyxl.styles.Font(b=True, color='000000', size=12)
    #ws['C2'] = 'Category'
    #ws['C2'].font = openpyxl.styles.Font(b=True, color='000000', size=12)
    ws['B2'] = 'Family Type'
    ws['B2'].font = openpyxl.styles.Font(b=True, color='000000', size=12)
    ws['C2'] = 'WorkMaster Code'
    ws['C2'].font = openpyxl.styles.Font(b=True, color='000000', size=12)
    #ws['F2'] = 'WorkMaster Description'
    #ws['F2'].font = openpyxl.styles.Font(b=True, color='000000', size=12)
    #ws['G2'] = 'Unit'
    #ws['G2'].font = openpyxl.styles.Font(b=True, color='000000', size=12)
    #ws['H2'] = '계수'
    #ws['H2'].font = openpyxl.styles.Font(b=True, color='000000', size=12)
    #ws['I2'] = '계산 참조값'
    #ws['I2'].font = openpyxl.styles.Font(b=True, color='000000', size=12)
    ws['D2'] = 'Quantities'
    ws['D2'].font = openpyxl.styles.Font(b=True, color='000000', size=12)
    ws['E2'] = 'Unit'
    ws['E2'].font = openpyxl.styles.Font(b=True, color='000000', size=12)
    ws['F2'] = 'Unit Price'
    ws['F2'].font = openpyxl.styles.Font(b=True, color='000000', size=12)
    ws['G2'] = 'Total Price'
    ws['G2'].font = openpyxl.styles.Font(b=True, color='000000', size=12)


## 칼럼별 너비 조정 구간
#    for col in range(ws.max_column):
#        ws.column_dimensions[chr(ord('A') + col)].width = 15
    ws.column_dimensions['A'].width = 15
    ws.column_dimensions['B'].width = 45
    ws.column_dimensions['C'].width = 60
    ws.column_dimensions['D'].width = 20
    ws.column_dimensions['E'].width = 20
    ws.column_dimensions['F'].width = 20
    ws.column_dimensions['G'].width = 20
    #ws.column_dimensions['G'].width = 9
    #ws.column_dimensions['H'].width = 9
    #ws.column_dimensions['H'].hidden = True
    #ws.column_dimensions['I'].width = 12
    #ws.column_dimensions['I'].hidden = True
    #ws.column_dimensions['J'].width = 12
    #ws.column_dimensions['K'].width = 12
    #ws.column_dimensions['L'].width = 12

###
    start_row = 3
    for (row, item) in enumerate(sample_items, start_row):
        cell = ws.cell(row=row, column=1, value=row - 2)
        cell.alignment = openpyxl.styles.Alignment(horizontal='center', vertical='center')

#        cell = ws.cell(row=row, column=2, value=item[0])
#        cell.number_format = openpyxl.styles.numbers.FORMAT_DATE_YYYYMMDD2  # 'yyyy-mm-dd'
        ws.cell(row=row, column=2, value=item[0]) ## Family Type 칼럼

        ws.cell(row=row, column=3, value=item[1]) ## WorkMaster Code 칼럼
        
        ws.cell(row=row, column=4, value=item[2]) ## Quantities 칼럼
        
        ws.cell(row=row, column=5, value=item[3]) ## Unit 칼럼
        
        #cell = ws.cell(row=row, column=8, value=item[6]) ## 계수 칼럼
        #cell.number_format = openpyxl.styles.numbers.builtin_format_code(3)  # '#,##0'
        
        #cell = ws.cell(row=row, column=9, value=item[7]) ## 계산 참조값 칼럼
        #cell.number_format = openpyxl.styles.numbers.builtin_format_code(3)  # '#,##0'
        
        #cell = ws.cell(row=row, column=10, value=item[8]) ## Quantities 칼럼
        #cell.number_format = openpyxl.styles.numbers.builtin_format_code(3)  # '#,##0'
        #cell.font = openpyxl.styles.Font(b=True, color='000000', size=11)

        cell = ws.cell(row=row, column=7, value='= D{current_row}*F{current_row}'.format(current_row=cell.row))
        cell.number_format = '#,##0'

#        cell = ws.cell(row=row, column=6, value='= D{current_row} * E{current_row}'.format(current_row=cell.row))
#        cell.number_format = openpyxl.styles.numbers.builtin_format_code(3)

    total_row = ws.max_row + 1
    if total_row > start_row:
        cell1 = ws.cell(row=total_row, column=6, value='Total')
        cell1.font = openpyxl.styles.Font(b=True, color='000000', size=15)
        
        cell2 = ws.cell(row=total_row, column=7, value='= SUM(G{}:G{})'.format(start_row, total_row - 1))
        cell2.number_format = openpyxl.styles.numbers.builtin_format_code(3)
        cell2.border = Border(top=double, left=double, right=double, bottom=double)
        cell2.font = openpyxl.styles.Font(b=True, color='ff03ce', size=15)
    

    wb.save(filepath)
    wb.close()


##if __name__ == '__main__':
#write_to_file('C:\\Users\\pjmk0\\AppData\\Roaming\\test.xlsx')

save_name = "HecStrFramingCalcSheet_" + Today.strftime("%Y-%m-%d")+".xlsx"
path = os.getenv('APPDATA').replace('\\','\\\\')
filePath = path + '\\' + save_name

write_to_file(filePath)

# Assign your output to the OUT variable.
OUT = os.getenv('APPDATA')
# ----------------------------------------

code_block_75 = CodeBlock {  }
code_block_76 = CodeBlock {  }
