# Dynamo graph 04 Str Foundation Calculator_DataStructureTest(1108)_mk.dyn (Dynamo 2.10.1.3976)

# note: 되메우기기
# note: GetWorkMasterCodePerElement

# group: Example
code_block = CodeBlock { ["a","b","c"]; [1,2,3]; }
byKeysValues = DesignScript.Builtin.Dictionary.ByKeysValues(keys=code_block.out0, values=code_block.out1)
code_block_2 = CodeBlock { ["d","e","f"]; [4,5,6]; }
byKeysValues_2 = DesignScript.Builtin.Dictionary.ByKeysValues(keys=code_block_2.out0, values=code_block_2.out1)
code_block_3 = CodeBlock(a1=byKeysValues, b1=byKeysValues_2)
# ---------- code_block_3.designscript (4 lines) ----------
{
"a1": a1
,"b1": b1
};
# ----------------------------------------
code_block_4 = CodeBlock { "a1"; }
valueAtKey = DesignScript.Builtin.Dictionary.ValueAtKey(dictionary=code_block_3, key=code_block_4)
code_block_5 = CodeBlock { "a"; }
valueAtKey_2 = DesignScript.Builtin.Dictionary.ValueAtKey(dictionary=valueAtKey, key=code_block_5)

# group: Primary Input
categories = Categories("OST_StructuralFoundation")
all_elements_of_category = ElementsOfCategory(Category=categories)
file_path = Filename(".\BIM_물량집계 자동화 산출기준표_rC(20211029).xlsx")
file_from_path = FileObject(path=file_path)
code_block_6 = CodeBlock { "Str Foundations"; }

# group: GetFull WMCodeDescription PerElement
getFullWMCodeDescriptionPerElement = Custom[GetFullWMCodeDescriptionPerElement](InputElement=all_elements_of_category, InputFilePath=file_from_path, InputSheetName=code_block_6)  # GetFullWMCodeDescriptionPerElement

# group: OrganizeAllElementInformAsDictionary
organizeAllElementInformAsDictionary = Custom[OrganizeAllElementInformAsDictionary](InputDic=getFullWMCodeDescriptionPerElement.Dictionary)  # OrganizeAllElementInformAsDictionary

# group: Select Target Family Element And Connected WorkMasters
code_block_7 = CodeBlock { 1; }
selectTargetFamilyInformAsDictionary = Custom[SelectTargetFamilyInformAsDictionary](InputDic=organizeAllElementInformAsDictionary, InputIndex=code_block_7)  # frozen; Select Target Family Element And Connected WorkMasters

# group: 하위분개
keys = DesignScript.Builtin.Dictionary.Keys(dictionary=selectTargetFamilyInformAsDictionary)
code_block_8 = CodeBlock(i=keys) { i; }
valueAtKey_3 = DesignScript.Builtin.Dictionary.ValueAtKey(dictionary=selectTargetFamilyInformAsDictionary, key=keys)
code_block_9 = CodeBlock { -1; }
dropItems = List.DropItems(list=valueAtKey_3, amount=code_block_9)
code_block_10 = CodeBlock { 0; }
code_block_11 = CodeBlock(i=dropItems) { i[0]; i[1]; i[2]; }
flatten = List.Flatten(list=code_block_11.out0)
replaceItemAtIndex = List.ReplaceItemAtIndex(list=dropItems, index=code_block_10, item=flatten)
code_block_12 = CodeBlock { 1; }
flatten_2 = List.Flatten(list=code_block_11.out1@L2)
replaceItemAtIndex_2 = List.ReplaceItemAtIndex(list=replaceItemAtIndex, index=code_block_12, item=flatten_2)
code_block_13 = CodeBlock { 2; }
flatten_3 = List.Flatten(list=code_block_11.out2)
replaceItemAtIndex_3 = List.ReplaceItemAtIndex(list=replaceItemAtIndex_2, index=code_block_13, item=flatten_3)
분개_index_입력 = CodeBlock { [0,4]; }
getItemAtIndex = List.GetItemAtIndex(list=replaceItemAtIndex_3@L3, index=분개_index_입력)
code_block_14 = CodeBlock(i=getItemAtIndex) { i[1]; }
flatten_4 = List.Flatten(list=code_block_14)
uniqueItems = List.UniqueItems(list=flatten_4)
addItemToEnd = List.AddItemToEnd(item=uniqueItems, list=getItemAtIndex)
byKeysValues_3 = DesignScript.Builtin.Dictionary.ByKeysValues(keys=code_block_8, values=addItemToEnd)

code_block_15 = CodeBlock(i=byKeysValues_3) { i; }

# group: Input Manager
value_for_import_from_others = CodeBlock(MainInput=code_block_15) { MainInput; RefInput1; RefInput2; }  # unwired: RefInput1, RefInput2

# group: <Func 9>Lean Concrete
code_block_16 = CodeBlock { "TargetElements"; }
valueAtKey_4 = DesignScript.Builtin.Dictionary.ValueAtKey(dictionary=value_for_import_from_others.MainInput, key=code_block_16)
code_block_17 = CodeBlock { 0; 100; }
# note: <Func>
createLeanConcrete = Custom[CreateLeanConcrete](Element=valueAtKey_4, leanOffset=code_block_17.out0, leanThick=code_block_17.out1)  # CreateLeanConcreteForISOFDN
volume = Solid.Volume(solid=createLeanConcrete.Solid)
code_block_18 = CodeBlock(i=volume) { Math.Round(List.Flatten(i)/1000000000, 2); }
code_block_19 = CodeBlock { "M3"; }
count = List.Count(list=code_block_18)
ofRepeatedItem = List.OfRepeatedItem(item=code_block_19, amount=count)
code_block_20 = CodeBlock(FuncValues=code_block_18, FuncValuesUnit=ofRepeatedItem)
# ---------- code_block_20.designscript (4 lines) ----------
{
"FuncValues": _FuncValues,
"FuncValuesUnit": _FuncValuesUnit
};
# ----------------------------------------

# group: Output Manager
reference_output = CodeBlock(ref=createLeanConcrete.Solid) { ref; }
output = CodeBlock(MainOutput=code_block_20, RefOutput_geoColor=createLeanConcrete.Solid) { MainOutput; RefOutput_geoColor; }

# group: Input Manager
value_for_import_from_others_2 = CodeBlock(MainInput=code_block_15, RefInput1=reference_output) { MainInput; RefInput1; RefInput2; }  # unwired: RefInput2

# group: <Func 4> Excavation (SOG 한정)
flatten_5 = List.Flatten(list=value_for_import_from_others_2.RefInput1)
하부_surface_추출 = Python(IN[0]=flatten_5)  # CPython3
# ---------- 하부_surface_추출.python (26 lines) ----------
# Load the Python Standard and DesignScript Libraries
import sys
import clr
import itertools
clr.AddReference('ProtoGeometry')
from Autodesk.DesignScript.Geometry import *

# The inputs to this node will be stored as a list in the IN variables.
dataEnteringNode = IN
input_elements = IN[0]

# Place your code below this line

srfs_input_elements = list(map(lambda x: x.Explode(), input_elements))

#srfs_input_flatten = list(itertools.chain(*srfs_input_elements))

def func_findZ_normalAtParma(srf):
    return srf.NormalAtParameter(0.5,0.5).Z
srfs_below = list(map(lambda y: filter(lambda x: func_findZ_normalAtParma(x) == -1, y), srfs_input_elements))

result = srfs_below


# Assign your output to the OUT variable.
OUT = result
# ----------------------------------------
flatten_6 = List.Flatten(list=하부_surface_추출)
perimeterCurves = Surface.PerimeterCurves(surface=flatten_6)
byJoinedCurves = PolyCurve.ByJoinedCurves(curves=perimeterCurves)
code_block_21 = CodeBlock { _ExcavOffsetBottom: var[]..[] = 300; }
offset = Curve.Offset(curve=byJoinedCurves, distance=code_block_21)
flatten_7 = List.Flatten(list=offset)
levels = Levels("G.L")  # graph input
elevation = Level.Elevation(level=levels)
code_block_22 = CodeBlock { "TargetElements"; }
valueAtKey_5 = DesignScript.Builtin.Dictionary.ValueAtKey(dictionary=value_for_import_from_others_2.MainInput, key=code_block_22)
code_block_23 = CodeBlock { "Elevation at Bottom"; }
getParameterValueByName = Element.GetParameterValueByName(element=valueAtKey_5, parameterName=code_block_23)
린_콘크리트_하부까지의_길이_추출_최하단 = Python(IN[0]=value_for_import_from_others_2.RefInput1)  # CPython3
# ---------- 린_콘크리트_하부까지의_길이_추출_최하단.python (22 lines) ----------
# Load the Python Standard and DesignScript Libraries
import sys
import clr
clr.AddReference('ProtoGeometry')
from Autodesk.DesignScript.Geometry import *

# The inputs to this node will be stored as a list in the IN variables.
dataEnteringNode = IN
inputs = IN[0]

# Place your code below this line

def findThickness(i):
    minPt_Z = BoundingBox.ByGeometry(i).MinPoint.Z
    maxPt_Z = BoundingBox.ByGeometry(i).MaxPoint.Z
    result = maxPt_Z - minPt_Z
    return result

thicknessByInput = list(map(findThickness, inputs))

# Assign your output to the OUT variable.
OUT = thicknessByInput
# ----------------------------------------
code_block_24 = CodeBlock(기초하단=getParameterValueByName, 린콘크리트하단=린_콘크리트_하부까지의_길이_추출_최하단) { 기초하단-린콘크리트하단; }
sub = elevation - code_block_24
flatten_8 = List.Flatten(list=sub)
translate = Geometry.Translate(geometry=offset, zTranslation=flatten_8)
경사_비율_입력_1_x_for_isofdn = DoubleInput(2)  # graph input
code_block_25 = CodeBlock(ElevationatBottom=flatten_8, 비율=경사_비율_입력_1_x_for_isofdn) { ElevationatBottom/비율; }
offset_2 = Curve.Offset(curve=translate, distance=code_block_25)
flatten_9 = List.Flatten(list=offset_2)
list_create = List.Create(item0=flatten_7, item1=flatten_9)
transpose = List.Transpose(lists=list_create)
byLoft = Solid.ByLoft(crossSections=transpose)
터파기_형상_겹침_해소 = Python(IN[0]=byLoft)  # CPython3
# ---------- 터파기_형상_겹침_해소.python (29 lines) ----------
# Load the Python Standard and DesignScript Libraries
import sys
import clr
clr.AddReference('ProtoGeometry')
from Autodesk.DesignScript.Geometry import *

# The inputs to this node will be stored as a list in the IN variables.
dataEnteringNode = IN
inputs = IN[0]
result = []
# Place your code below this line

for x in range(len(inputs)):
    if x < len(inputs)-1:
        temp = []
        apply = inputs[x]
        for y in range(x,len(inputs)):
            if apply.DoesIntersect(inputs[y]):
                apply = apply.Split(inputs[y])[0]
                temp.append(apply)
            else:
                apply = apply
                temp.append(apply)
        result.append(temp[-1])
    elif x == len(inputs)-1:
        result.append(inputs[x])

# Assign your output to the OUT variable.
OUT = result
# ----------------------------------------
code_block_26 = CodeBlock(i=sub) { i<0?true:false; }
code_block_27 = CodeBlock { 0; }
volume_2 = Solid.Volume(solid=터파기_형상_겹침_해소)
code_block_28 = CodeBlock(i=volume_2) { Math.Round(List.Flatten(i)/1000000000, 2); }
if_ = If(test=code_block_26, true=code_block_27, false=code_block_28)
code_block_29 = CodeBlock { "M3"; }
count_2 = List.Count(list=code_block_28)
ofRepeatedItem_2 = List.OfRepeatedItem(item=code_block_29, amount=count_2)
code_block_30 = CodeBlock(FuncValues=if_, FuncValuesUnit=ofRepeatedItem_2)  # same code as code_block_20
color_palette = ColorPalette({R: 210, G: 105, B: 30, A: 135})
byGeometryColor = Modifiers.GeometryColor.ByGeometryColor(geometry=터파기_형상_겹침_해소, color=color_palette)
forRefOutput = CodeBlock(MainOutput=code_block_30, geoColor=byGeometryColor, 터파기형상=터파기_형상_겹침_해소)
# ---------- forRefOutput.designscript (5 lines) ----------
{
"MainOutput": MainOutput,
"geoColor": geoColor,
"터파기형상": 터파기형상
};
# ----------------------------------------

# group: Output Manager
reference_output_2 = CodeBlock(ref=터파기_형상_겹침_해소, ref2=if_) { ref; ref2; }
output_2 = CodeBlock(MainOutput=forRefOutput, RefOutput_geoColor=byGeometryColor) { MainOutput; RefOutput_geoColor; }

# group: Input Manager
value_for_import_from_others_3 = CodeBlock(MainInput=code_block_15, RefInput1=reference_output_2.ref2) { MainInput; RefInput1; RefInput2; }  # unwired: RefInput2

# group: <Func 6>Disposal
code_block_31 = CodeBlock { "TargetElements"; }
valueAtKey_6 = DesignScript.Builtin.Dictionary.ValueAtKey(dictionary=value_for_import_from_others_3.MainInput, key=code_block_31)
count_3 = List.Count(list=valueAtKey_6@L1)
code_block_32 = CodeBlock(i=value_for_import_from_others_3.RefInput1) { i==0?true:false; }
code_block_33 = CodeBlock { 0; }
# note: <Func>
if_2 = If(test=code_block_32, true=code_block_33, false=value_for_import_from_others_3.RefInput1)
code_block_34 = CodeBlock(i=if_2) { Math.Round(List.Flatten(i)/1000000000, 2); }
code_block_35 = CodeBlock { "M3"; }
count_4 = List.Count(list=code_block_34)
ofRepeatedItem_3 = List.OfRepeatedItem(item=code_block_35, amount=count_4)
code_block_36 = CodeBlock(FuncValues=code_block_34, FuncValuesUnit=ofRepeatedItem_3)  # same code as code_block_20

# group: Distributer
code_block_37 = CodeBlock { i; }  # frozen; unwired: i
code_block_38 = CodeBlock(i=code_block_37) { i; }
code_block_39 = CodeBlock(i=code_block_38) { i; }
code_block_40 = CodeBlock(i=code_block_38) { i; }
code_block_41 = CodeBlock(i=code_block_37) { i; }
code_block_42 = CodeBlock(i=code_block_41) { i; }
code_block_43 = CodeBlock(i=code_block_37) { i; }
code_block_44 = CodeBlock(i=code_block_43) { i; }
code_block_45 = CodeBlock(i=code_block_37) { i; }
code_block_46 = CodeBlock(i=code_block_45) { i; }
code_block_47 = CodeBlock(i=code_block_38) { i; }
code_block_48 = CodeBlock(i=code_block_43) { i; }
code_block_49 = CodeBlock(i=code_block_43) { i; }
code_block_50 = CodeBlock(i=code_block_45) { i; }
code_block_51 = CodeBlock(i=code_block_45) { i; }
code_block_52 = CodeBlock(i=code_block_41) { i; }

code_block_53 = CodeBlock { "TargetElements"; }
valueAtKey_7 = DesignScript.Builtin.Dictionary.ValueAtKey(dictionary=code_block_39, key=code_block_53)
# note: <Func>
extractUpperFacesOfElement = Custom[ExtractUpperFacesOfElement](Element=valueAtKey_7)  # ExtractUpperFacesOfElement

# group: <Func 2> - 수정필요
code_block_54 = CodeBlock { "TargetElements"; }
valueAtKey_8 = DesignScript.Builtin.Dictionary.ValueAtKey(dictionary=code_block_40, key=code_block_54)
# note: <Func>
extractSideFacesOfElement = Custom[ExtractSideFacesOfElement](Element=valueAtKey_8)  # ExtractSideFacesOfElement
area = Surface.Area(surface=extractSideFacesOfElement.Surface)
sum = Math.Sum(values=area)
code_block_55 = CodeBlock(i=sum) { Math.Round(List.Flatten(i)/1000000, 2); }
code_block_56 = CodeBlock { "M2"; }
count_5 = List.Count(list=code_block_55)
ofRepeatedItem_4 = List.OfRepeatedItem(item=code_block_56, amount=count_5)
code_block_57 = CodeBlock(FuncValues=code_block_55, FuncValuesUnit=ofRepeatedItem_4)  # same code as code_block_20

code_block_58 = CodeBlock { "TargetElements"; }
valueAtKey_9 = DesignScript.Builtin.Dictionary.ValueAtKey(dictionary=code_block_42, key=code_block_58)
code_block_59 = CodeBlock { 0; 100; }
createLeanConcrete_2 = Custom[CreateLeanConcrete](Element=valueAtKey_9, leanOffset=code_block_59.out0, leanThick=code_block_59.out1)
code_block_60 = CodeBlock { "TargetElements"; }
valueAtKey_10 = DesignScript.Builtin.Dictionary.ValueAtKey(dictionary=code_block_44, key=code_block_60)
code_block_61 = CodeBlock { 0; }
createExcavationSolid = Custom[CreateExcavationSolid](Element=valueAtKey_10, ExcavOffsetTop=code_block_61, ExcavOffsetBottom=code_block_61)  # CreateExcavationSolidForISOFDN
code_block_62 = CodeBlock { "TargetElements"; }
valueAtKey_11 = DesignScript.Builtin.Dictionary.ValueAtKey(dictionary=code_block_46, key=code_block_62)
createBaseCourseSurfaces = Custom[CreateBaseCourseSurfaces](Element=valueAtKey_11)  # CreateBaseCourseSurfaces

# group: See Result
code_block_63 = CodeBlock(SeeResult=extractUpperFacesOfElement.GeometryColor) { SeeResult; }
code_block_64 = CodeBlock(SeeResult=extractSideFacesOfElement.GeometryColor) { SeeResult; }
code_block_65 = CodeBlock(SeeResult=createLeanConcrete_2.GeometryColor) { SeeResult; }
code_block_66 = CodeBlock(SeeResult=createExcavationSolid.GeometryColor) { SeeResult; }
code_block_67 = CodeBlock(SeeResult=createBaseCourseSurfaces.GeometryColor) { SeeResult; }

# group: Select Target Family Element And Connected WorkMasters
code_block_68 = CodeBlock { 0; }
selectTargetFamilyInformAsDictionary_2 = Custom[SelectTargetFamilyInformAsDictionary](InputIndex=code_block_68)  # unwired: InputDic

# group: <Func 0> Input Manager
value_for_import_from_others_4 = CodeBlock(MainInput=selectTargetFamilyInformAsDictionary_2) { MainInput; RefInput; }  # unwired: RefInput

# group: <Func 0> Structural Concrete
code_block_69 = CodeBlock { "TargetElements"; }
valueAtKey_12 = DesignScript.Builtin.Dictionary.ValueAtKey(dictionary=value_for_import_from_others_4.MainInput, key=code_block_69)
code_block_70 = CodeBlock { "Volume"; }
# note: <Func>
getParameterValueByName_2 = Element.GetParameterValueByName(element=valueAtKey_12, parameterName=code_block_70)
code_block_71 = CodeBlock(i=getParameterValueByName_2) { Math.Round(List.Flatten(i)/1, 2); }
code_block_72 = CodeBlock { "M3"; }
count_6 = List.Count(list=code_block_71)
ofRepeatedItem_5 = List.OfRepeatedItem(item=code_block_72, amount=count_6)
code_block_73 = CodeBlock(FuncValues=code_block_71, FuncValuesUnit=ofRepeatedItem_5)  # same code as code_block_20

# group: <Func 0> Output Manager
output_3 = CodeBlock(MainOutput=code_block_73) { MainOutput; RefOutput1; RefOutput2; }  # unwired: RefOutput1, RefOutput2
reference_output_3 = CodeBlock { ref; }  # unwired: ref

# group: <Func 5> Input Manager
value_for_import_from_others_5 = CodeBlock(MainInput=selectTargetFamilyInformAsDictionary_2) { MainInput; RefInput; }  # unwired: RefInput

# group: <Func 5> Lean Concrete
code_block_74 = CodeBlock { "TargetElements"; }
valueAtKey_13 = DesignScript.Builtin.Dictionary.ValueAtKey(dictionary=value_for_import_from_others_5.MainInput, key=code_block_74)
# note: <Func>
createLeanConcrete_3 = Custom[CreateLeanConcrete](Element=valueAtKey_13)
flatten_10 = List.Flatten(list=createLeanConcrete_3.Solid)
value_for_export_to_others = CodeBlock(린콘크리트형상=flatten_10) { 린콘크리트형상; }
volume_3 = Solid.Volume(solid=createLeanConcrete_3.Solid)
code_block_75 = CodeBlock(i=volume_3) { Math.Round(List.Flatten(i)/1000000000, 2); }
code_block_76 = CodeBlock { "M3"; }
count_7 = List.Count(list=code_block_75)
ofRepeatedItem_6 = List.OfRepeatedItem(item=code_block_76, amount=count_7)
code_block_77 = CodeBlock(FuncValues=code_block_75, FuncValuesUnit=ofRepeatedItem_6)  # same code as code_block_20

# group: <Func 5> Output Manager
reference_output_4 = CodeBlock(ref=value_for_export_to_others) { ref; }
output_4 = CodeBlock(MainOutput=code_block_77, RefOutput_geoColor=createLeanConcrete_3.GeometryColor) { MainOutput; RefOutput_geoColor; }

# group: <Func 1> Input Manager
value_for_import_from_others_6 = CodeBlock(MainInput=selectTargetFamilyInformAsDictionary_2, RefInput=reference_output_4) { MainInput; RefInput; }

# group: <Func 1-1> Excavation by IsoFDN
하부_surface_추출_2 = Python(IN[0]=value_for_import_from_others_6.RefInput)  # CPython3; same code as 하부_surface_추출
flatten_11 = List.Flatten(list=하부_surface_추출_2)
perimeterCurves_2 = Surface.PerimeterCurves(surface=flatten_11)
byJoinedCurves_2 = PolyCurve.ByJoinedCurves(curves=perimeterCurves_2)
code_block_78 = CodeBlock { _ExcavOffsetBottom: var[]..[] = 300; }
offset_3 = Curve.Offset(curve=byJoinedCurves_2, distance=code_block_78)
flatten_12 = List.Flatten(list=offset_3)
levels_2 = Levels("G.L")  # graph input
elevation_2 = Level.Elevation(level=levels_2)
code_block_79 = CodeBlock { "TargetElements"; }
valueAtKey_14 = DesignScript.Builtin.Dictionary.ValueAtKey(dictionary=value_for_import_from_others_6.MainInput, key=code_block_79)
code_block_80 = CodeBlock { "Elevation at Bottom"; }
getParameterValueByName_3 = Element.GetParameterValueByName(element=valueAtKey_14, parameterName=code_block_80)
린_콘크리트_하부까지의_길이_추출_최하단_2 = Python(IN[0]=value_for_import_from_others_6.RefInput)  # CPython3; same code as 린_콘크리트_하부까지의_길이_추출_최하단
code_block_81 = CodeBlock(기초하단=getParameterValueByName_3, 린콘크리트하단=린_콘크리트_하부까지의_길이_추출_최하단_2) { 기초하단-린콘크리트하단; }
sub_2 = elevation_2 - code_block_81
code_block_82 = CodeBlock { 0; }
isNull = Object.IsNull()  # unwired: object
replaceByCondition = Replace(item=sub_2, replaceWith=code_block_82, condition=isNull)
flatten_13 = List.Flatten(list=replaceByCondition)
translate_2 = Geometry.Translate(geometry=offset_3, zTranslation=flatten_13)
경사_비율_입력_1_x_for_isofdn_2 = DoubleInput(2)  # graph input
code_block_83 = CodeBlock(ElevationatBottom=flatten_13, 비율=경사_비율_입력_1_x_for_isofdn_2) { ElevationatBottom/비율; }
offset_4 = Curve.Offset(curve=translate_2, distance=code_block_83)
flatten_14 = List.Flatten(list=offset_4)
list_create_2 = List.Create(item0=flatten_12, item1=flatten_14)
transpose_2 = List.Transpose(lists=list_create_2)
byLoft_2 = Solid.ByLoft(crossSections=transpose_2)
터파기_형상_겹침_해소_2 = Python(IN[0]=byLoft_2)  # CPython3; same code as 터파기_형상_겹침_해소
volume_4 = Solid.Volume(solid=터파기_형상_겹침_해소_2)
code_block_84 = CodeBlock(i=volume_4) { Math.Round(List.Flatten(i)/1000000000, 2); }
code_block_85 = CodeBlock { "M3"; }
count_8 = List.Count(list=code_block_84)
ofRepeatedItem_7 = List.OfRepeatedItem(item=code_block_85, amount=count_8)
code_block_86 = CodeBlock(FuncValues=code_block_84, FuncValuesUnit=ofRepeatedItem_7)  # same code as code_block_20
color_palette_2 = ColorPalette({R: 210, G: 105, B: 30, A: 135})
byGeometryColor_2 = Modifiers.GeometryColor.ByGeometryColor(geometry=터파기_형상_겹침_해소_2, color=color_palette_2)
forRefOutput_2 = CodeBlock(MainOutput=code_block_86, geoColor=byGeometryColor_2, 터파기형상=터파기_형상_겹침_해소_2)  # same code as forRefOutput

# group: <Func 1-2> Excavation by Overall
하부_surface_추출_3 = Python(IN[0]=value_for_import_from_others_6.RefInput)  # CPython3; same code as 하부_surface_추출
flatten_15 = List.Flatten(list=하부_surface_추출_3)
byGeometry = BoundingBox.ByGeometry(geom=flatten_15)
toCuboid = BoundingBox.ToCuboid(boundingBox=byGeometry)
code_block_87 = CodeBlock(i=toCuboid) { [i]; }
하부_surface_추출_4 = Python(IN[0]=code_block_87)  # CPython3; same code as 하부_surface_추출
perimeterCurves_3 = Surface.PerimeterCurves(surface=하부_surface_추출_4)
byJoinedCurves_3 = PolyCurve.ByJoinedCurves(curves=perimeterCurves_3)
code_block_88 = CodeBlock { _ExcavOffsetBottom: var[]..[] = 300; }
offset_5 = Curve.Offset(curve=byJoinedCurves_3, distance=code_block_88)
flatten_16 = List.Flatten(list=offset_5)
levels_3 = Levels("G.L")  # graph input
elevation_3 = Level.Elevation(level=levels_3)
code_block_89 = CodeBlock { "TargetElements"; }
valueAtKey_15 = DesignScript.Builtin.Dictionary.ValueAtKey(dictionary=value_for_import_from_others_6.MainInput, key=code_block_89)
code_block_90 = CodeBlock { "Elevation at Bottom"; }
getParameterValueByName_4 = Element.GetParameterValueByName(element=valueAtKey_15, parameterName=code_block_90)
린_콘크리트_하부까지의_길이_추출_최하단_3 = Python(IN[0]=value_for_import_from_others_6.RefInput)  # CPython3; same code as 린_콘크리트_하부까지의_길이_추출_최하단
code_block_91 = CodeBlock(기초하단=getParameterValueByName_4, 린콘크리트하단=린_콘크리트_하부까지의_길이_추출_최하단_3) { 기초하단-린콘크리트하단; }
uniqueItems_2 = List.UniqueItems(list=code_block_91@L2)
sub_3 = elevation_3 - uniqueItems_2
code_block_92 = CodeBlock { 0; }
isNull_2 = Object.IsNull()  # unwired: object
replaceByCondition_2 = Replace(item=sub_3, replaceWith=code_block_92, condition=isNull_2)
flatten_17 = List.Flatten(list=replaceByCondition_2)
translate_3 = Geometry.Translate(geometry=offset_5, zTranslation=flatten_17)
경사_비율_입력_1_x_for_overall = DoubleInput(2)  # graph input
code_block_93 = CodeBlock(ElevationatBottom=flatten_17, 비율=경사_비율_입력_1_x_for_overall) { ElevationatBottom/비율; }
offset_6 = Curve.Offset(curve=translate_3, distance=code_block_93)
flatten_18 = List.Flatten(list=offset_6)
list_create_3 = List.Create(item0=flatten_16, item1=flatten_18)
transpose_3 = List.Transpose(lists=list_create_3)
byLoft_3 = Solid.ByLoft(crossSections=transpose_3)
터파기_형상_겹침_해소_3 = Python(IN[0]=byLoft_3)  # CPython3; same code as 터파기_형상_겹침_해소
volume_5 = Solid.Volume(solid=터파기_형상_겹침_해소_3)
code_block_94 = CodeBlock(i=volume_5) { Math.Round(List.Flatten(i)/1000000000, 2); }
code_block_95 = CodeBlock { "M3"; }
count_9 = List.Count(list=code_block_94)
ofRepeatedItem_8 = List.OfRepeatedItem(item=code_block_95, amount=count_9)
code_block_96 = CodeBlock(FuncValues=code_block_94, FuncValuesUnit=ofRepeatedItem_8)  # same code as code_block_20
color_palette_3 = ColorPalette({R: 210, G: 105, B: 30, A: 135})
byGeometryColor_3 = Modifiers.GeometryColor.ByGeometryColor(geometry=터파기_형상_겹침_해소_3, color=color_palette_3)
forRefOutput_3 = CodeBlock(MainOutput=code_block_96, geoColor=byGeometryColor_3, 터파기형상=터파기_형상_겹침_해소_3)  # same code as forRefOutput

# group: 함수 선택
터파기_산출_타입_선택_iso_or_overall = StringInput("iso")  # graph input
code_block_97 = CodeBlock(functionName=터파기_산출_타입_선택_iso_or_overall) { functionName == "iso"? true:false; }
if_3 = If(test=code_block_97, true=forRefOutput_2, false=forRefOutput_3)

# group: <Func 1> Output Manager
code_block_98 = CodeBlock { "MainOutput"; }
valueAtKey_16 = DesignScript.Builtin.Dictionary.ValueAtKey(dictionary=if_3, key=code_block_98)
code_block_99 = CodeBlock { "geoColor"; }
valueAtKey_17 = DesignScript.Builtin.Dictionary.ValueAtKey(dictionary=if_3, key=code_block_99)
output_5 = CodeBlock(MainOutput=valueAtKey_16, RefOutput_geoColor=valueAtKey_17) { MainOutput; RefOutput_geoColor; }
code_block_100 = CodeBlock { "터파기형상"; }
valueAtKey_18 = DesignScript.Builtin.Dictionary.ValueAtKey(dictionary=if_3, key=code_block_100)
reference_output_5 = CodeBlock(터파기형상=valueAtKey_18) { 터파기형상; }

# group: <Func 2> Input Manager
value_for_import_from_others_7 = CodeBlock(MainInput=selectTargetFamilyInformAsDictionary_2, RefInput1=reference_output_5, RefInput2=reference_output_4) { MainInput; RefInput1; RefInput2; }

# group: <Func 2> Backfill
value_for_import_from_others_8 = CodeBlock(터파기형상=value_for_import_from_others_7.RefInput1) { 터파기형상; }
flatten_19 = List.Flatten(list=value_for_import_from_others_8)
volume_6 = Solid.Volume(solid=flatten_19)
flatten_20 = List.Flatten(list=value_for_import_from_others_7.RefInput2)
code_block_101 = CodeBlock { "TargetElements"; }
valueAtKey_19 = DesignScript.Builtin.Dictionary.ValueAtKey(dictionary=value_for_import_from_others_7.MainInput, key=code_block_101)
geometry = Element.Geometry(element=valueAtKey_19)
flatten_21 = List.Flatten(list=geometry)
categories_2 = Categories("OST_StructuralColumns")
all_elements_of_category_2 = ElementsOfCategory(Category=categories_2)
geometry_2 = Element.Geometry(element=all_elements_of_category_2)
flatten_22 = List.Flatten(list=geometry_2)
doesIntersect = Geometry.DoesIntersect(geometry=flatten_19, other=flatten_22, lacing=CrossProduct)
filterByBoolMask = List.FilterByBoolMask(list=flatten_22, mask=doesIntersect@L2)
flatten_23 = List.Flatten(list=filterByBoolMask.in)
list_create_4 = List.Create(item0=flatten_20, item1=flatten_21, item2=flatten_23)
transpose_4 = List.Transpose(lists=list_create_4)
byUnion = Solid.ByUnion(solids=transpose_4)
volume_7 = Solid.Volume(solid=byUnion)
code_block_102 = CodeBlock(터파기볼륨=volume_6, 콘크리트들볼륨=volume_7) { 터파기볼륨 - 콘크리트들볼륨; }
watch = Watch(code_block_102)
code_block_103 = CodeBlock(i=watch) { Math.Round(List.Flatten(i)/1000000000, 2); }
code_block_104 = CodeBlock { "M3"; }
count_10 = List.Count(list=watch)
ofRepeatedItem_9 = List.OfRepeatedItem(item=code_block_104, amount=count_10)
# note: 터파기 물량ㅈ에서 콘크리트, 린 기둥 물량 빼기
code_block_105 = CodeBlock(FuncValues=code_block_103, FuncValuesUnit=ofRepeatedItem_9)  # same code as code_block_20

# group: <Func 2> Output Manager
output_6 = CodeBlock(MainOutput=code_block_105) { MainOutput; RefOutput_geoColor; }  # unwired: RefOutput_geoColor
reference_output_6 = CodeBlock(콘크리트들볼륨=volume_7) { 콘크리트들볼륨; }

# group: <Func 3> Input Manager
value_for_import_from_others_9 = CodeBlock(MainInput=selectTargetFamilyInformAsDictionary_2, RefInput1=reference_output_6) { MainInput; RefInput1; RefInput2; }  # unwired: RefInput2

# group: <Func 3> Disposal (잔토처리 1.2 비율)
watch_2 = Watch(value_for_import_from_others_9.RefInput1)
토량_환산_계수 = DoubleInput(1)  # graph input
code_block_106 = CodeBlock(i=watch_2, 토량환산계수=토량_환산_계수) { Math.Round(List.Flatten(i)/1000000000, 2)*토량환산계수; }
code_block_107 = CodeBlock { "M3"; }
count_11 = List.Count(list=watch_2)
ofRepeatedItem_10 = List.OfRepeatedItem(item=code_block_107, amount=count_11)
# note: 잔토처리
code_block_108 = CodeBlock(FuncValues=code_block_106, FuncValuesUnit=ofRepeatedItem_10)  # same code as code_block_20

# group: <Func 3> Output Manager
output_7 = CodeBlock(MainOutput=code_block_108) { MainOutput; RefOutput_geoColor; }  # unwired: RefOutput_geoColor
reference_output_7 = CodeBlock { ref; }  # unwired: ref

# group: <Func 4> Input Manager
value_for_import_from_others_10 = CodeBlock(MainInput=selectTargetFamilyInformAsDictionary_2) { MainInput; RefInput1; RefInput2; }  # unwired: RefInput1, RefInput2

# group: <Func 4> Base Course
code_block_109 = CodeBlock { "TargetElements"; }
valueAtKey_20 = DesignScript.Builtin.Dictionary.ValueAtKey(dictionary=value_for_import_from_others_10.MainInput, key=code_block_109)
# note: <Func>
createBaseCourseSurfaces_2 = Custom[CreateBaseCourseSurfaces](Element=valueAtKey_20)
area_2 = Surface.Area(surface=createBaseCourseSurfaces_2.Surface)
code_block_110 = CodeBlock(i=area_2) { Math.Round(List.Flatten(i)/1000000, 2); }
code_block_111 = CodeBlock { "M2"; }
count_12 = List.Count(list=code_block_110)
ofRepeatedItem_11 = List.OfRepeatedItem(item=code_block_111, amount=count_12)
code_block_112 = CodeBlock(FuncValues=code_block_110, FuncValuesUnit=ofRepeatedItem_11)  # same code as code_block_20

# group: <Func 4> Output Manager
output_8 = CodeBlock(MainOutput=code_block_112, RefOutput_geoColor=createBaseCourseSurfaces_2.GeometryColor) { MainOutput; RefOutput_geoColor; }
reference_output_8 = CodeBlock { ref; }  # unwired: ref

# group: <Func 6> Input Manager
value_for_import_from_others_11 = CodeBlock(MainInput=selectTargetFamilyInformAsDictionary_2) { MainInput; RefInput1; RefInput2; }  # unwired: RefInput1, RefInput2

# group: <Func 6> Form Works
code_block_113 = CodeBlock { "TargetElements"; }
valueAtKey_21 = DesignScript.Builtin.Dictionary.ValueAtKey(dictionary=value_for_import_from_others_11.MainInput, key=code_block_113)
# note: <Func>
extractSideFacesOfElement_2 = Custom[ExtractSideFacesOfElement](Element=valueAtKey_21)
area_3 = Surface.Area(surface=extractSideFacesOfElement_2.Surface)
sum_2 = Math.Sum(values=area_3)
code_block_114 = CodeBlock(i=sum_2) { Math.Round(List.Flatten(i)/1000000, 2); }
code_block_115 = CodeBlock { "M2"; }
count_13 = List.Count(list=code_block_114)
ofRepeatedItem_12 = List.OfRepeatedItem(item=code_block_115, amount=count_13)
code_block_116 = CodeBlock(FuncValues=code_block_114, FuncValuesUnit=ofRepeatedItem_12)  # same code as code_block_20

# group: <Func 6> Output Manager
output_9 = CodeBlock(MainOutput=code_block_116, RefOutput_geoColor=extractSideFacesOfElement_2.GeometryColor) { MainOutput; RefOutput_geoColor; }
reference_output_9 = CodeBlock { ref; }  # unwired: ref

# group: <Func 7> Input Manager
value_for_import_from_others_12 = CodeBlock(MainInput=selectTargetFamilyInformAsDictionary_2) { MainInput; RefInput1; RefInput2; factor; }  # unwired: RefInput1, RefInput2, factor

# group: <Func 7> Rebar
code_block_117 = CodeBlock { "TargetElements"; }
valueAtKey_22 = DesignScript.Builtin.Dictionary.ValueAtKey(dictionary=value_for_import_from_others_12.MainInput, key=code_block_117)
code_block_118 = CodeBlock { "Volume"; }
# note: <Func>
getParameterValueByName_5 = Element.GetParameterValueByName(element=valueAtKey_22, parameterName=code_block_118)
독립기초_철근비 = DoubleInput(0)  # graph input
mul = getParameterValueByName_5 * 독립기초_철근비
code_block_119 = CodeBlock(i=mul) { Math.Round(List.Flatten(i)/1, 2); }
code_block_120 = CodeBlock { "TON"; }
count_14 = List.Count(list=code_block_119)
ofRepeatedItem_13 = List.OfRepeatedItem(item=code_block_120, amount=count_14)
code_block_121 = CodeBlock(FuncValues=code_block_119, FuncValuesUnit=ofRepeatedItem_13)  # same code as code_block_20

# group: <Func 7> Output Manager
output_10 = CodeBlock(MainOutput=code_block_121) { MainOutput; RefOutput_geoColor; }  # unwired: RefOutput_geoColor
reference_output_10 = CodeBlock { ref; }  # unwired: ref

# group: <Func 8> Input Manager
value_for_import_from_others_13 = CodeBlock(MainInput=selectTargetFamilyInformAsDictionary_2) { MainInput; RefInput1; RefInput2; }  # unwired: RefInput1, RefInput2

# group: <Func 8> Sheet Memebrane
code_block_122 = CodeBlock { "TargetElements"; }
valueAtKey_23 = DesignScript.Builtin.Dictionary.ValueAtKey(dictionary=value_for_import_from_others_13.MainInput, key=code_block_122)
# note: <Func>
createLeanConcrete_4 = Custom[CreateLeanConcrete](Element=valueAtKey_23)
area_4 = Surface.Area(surface=createLeanConcrete_4.Surface)
code_block_123 = CodeBlock(i=area_4) { Math.Round(List.Flatten(i)/1000000, 2); }
code_block_124 = CodeBlock { "M2"; }
count_15 = List.Count(list=code_block_123)
ofRepeatedItem_14 = List.OfRepeatedItem(item=code_block_124, amount=count_15)
code_block_125 = CodeBlock(FuncValues=code_block_123, FuncValuesUnit=ofRepeatedItem_14)  # same code as code_block_20

# group: <Func 8> Output Manager
output_11 = CodeBlock(MainOutput=code_block_125) { MainOutput; RefOutput_geoColor; }  # unwired: RefOutput_geoColor
reference_output_11 = CodeBlock { ref; }  # unwired: ref

# group: <Func 9> Input Manager
value_for_import_from_others_14 = CodeBlock(MainInput=selectTargetFamilyInformAsDictionary_2) { MainInput; RefInput1; RefInput2; }  # unwired: RefInput1, RefInput2

# group: <Func 9> Membrane Protection Board (측면 + 상부면 중 pedestal 점유면적 제외)
code_block_126 = CodeBlock { "TargetElements"; }
# note: <Func>
valueAtKey_24 = DesignScript.Builtin.Dictionary.ValueAtKey(dictionary=value_for_import_from_others_14.MainInput, key=code_block_126)
code_block_127 = CodeBlock(Element=valueAtKey_24) { _Element; }
extractUpperFacesOfElement_2 = Custom[ExtractUpperFacesOfElement](Element=code_block_127)
flatten_24 = List.Flatten(list=extractUpperFacesOfElement_2.Surface)
getJoinedElements = Element.GetJoinedElements(element=code_block_127)
flatten_25 = List.Flatten(list=getJoinedElements)
extractBelowFacesOfElement = Custom[ExtractBelowFacesOfElement](Element=flatten_25)  # ExtractBelowFacesOfElement
flatten_26 = List.Flatten(list=extractBelowFacesOfElement.Surface)
doesIntersect_2 = Geometry.DoesIntersect(geometry=flatten_26, other=flatten_24, lacing=CrossProduct)
code_block_128 = CodeBlock { true; }
allIndicesOf = List.AllIndicesOf(list=doesIntersect_2@L2, item=code_block_128)
flatten_27 = List.Flatten(list=allIndicesOf)
groupByKey = List.GroupByKey(list=flatten_26, keys=flatten_27)
difference = Surface.Difference(surface=flatten_24, others=groupByKey.groups)
extractSideFacesOfElement_3 = Custom[ExtractSideFacesOfElement](Element=code_block_127)
addItemToFront = List.AddItemToFront(item=difference@L1, list=extractSideFacesOfElement_3.Surface@L2)
area_5 = Surface.Area(surface=addItemToFront)
sum_3 = Math.Sum(values=area_5)
code_block_129 = CodeBlock(i=sum_3) { Math.Round(List.Flatten(i)/1000000, 2); }
code_block_130 = CodeBlock { "M2"; }
count_16 = List.Count(list=code_block_129)
ofRepeatedItem_15 = List.OfRepeatedItem(item=code_block_130, amount=count_16)
code_block_131 = CodeBlock(FuncValues=code_block_129, FuncValuesUnit=ofRepeatedItem_15)  # same code as code_block_20
color_palette_4 = ColorPalette({R: 30, G: 144, B: 255, A: 129})
byGeometryColor_4 = Modifiers.GeometryColor.ByGeometryColor(geometry=addItemToFront, color=color_palette_4)

# group: <Func 9> Output Manager
output_12 = CodeBlock(MainOutput=code_block_131, RefOutput_geoColor=byGeometryColor_4) { MainOutput; RefOutput_geoColor; }
reference_output_12 = CodeBlock { ref; }  # unwired: ref

join = List.Join(list0=output_3.MainOutput, list1=output_5.MainOutput, list2=output_6.MainOutput, list3=output_7.MainOutput, list4=output_8.MainOutput, list5=output_4.MainOutput, list6=output_9.MainOutput, list7=output_10.MainOutput, list8=output_11.MainOutput, list9=output_12.MainOutput)

# group: TargetWMunique + Data Sending
code_block_132 = CodeBlock(InputDic2=join) { _InputDic2; }
count_17 = List.Count(list=code_block_132)
code_block_133 = CodeBlock(InputDic1=selectTargetFamilyInformAsDictionary_2) { _InputDic1; }
code_block_134 = CodeBlock { "TargetWMunique"; }
valueAtKey_25 = DesignScript.Builtin.Dictionary.ValueAtKey(dictionary=code_block_133, key=code_block_134)
watch_3 = Watch(valueAtKey_25)
count_18 = List.Count(list=watch_3)
eq = count_17 == count_18
organizeFuncValuesAndWorkMasterAsDiction = Custom[OrganizeFuncValuesAndWorkMasterAsDictionary](InputDic1=code_block_133, InputDic2=code_block_132)  # Organize FuncValues and WorkMaster As Dictionary
watch_4 = Watch()  # unwired: arg0
if_4 = If(test=eq, true=organizeFuncValuesAndWorkMasterAsDiction, false=watch_4)

# group: 데이터 취합 및 Row 방향 정렬
code_block_135 = CodeBlock(InputDic=if_4) { _InputDic; }
code_block_136 = CodeBlock { "TrTargetFamilyCode"; }
valueAtKey_26 = DesignScript.Builtin.Dictionary.ValueAtKey(dictionary=code_block_135, key=code_block_136)
watch_5 = Watch(valueAtKey_26)
flatten_28 = List.Flatten(list=watch_5)
code_block_137 = CodeBlock { "WMforTargetElements"; }
valueAtKey_27 = DesignScript.Builtin.Dictionary.ValueAtKey(dictionary=code_block_135, key=code_block_137)
watch_6 = Watch(valueAtKey_27)
flatten_29 = List.Flatten(list=watch_6)
code_block_138 = CodeBlock { "TargetFuncValues"; }
valueAtKey_28 = DesignScript.Builtin.Dictionary.ValueAtKey(dictionary=code_block_135, key=code_block_138)
watch_7 = Watch(valueAtKey_28)
flatten_30 = List.Flatten(list=watch_7)
code_block_139 = CodeBlock { "TargetFuncValuesUnit"; }
valueAtKey_29 = DesignScript.Builtin.Dictionary.ValueAtKey(dictionary=code_block_135, key=code_block_139)
watch_8 = Watch(valueAtKey_29)
flatten_31 = List.Flatten(list=watch_8)
list_create_5 = List.Create(item0=flatten_28, item1=flatten_29, item2=flatten_30, item3=flatten_31)
transpose_5 = List.Transpose(lists=list_create_5)

# group: TargetWMunique + Data Sending
code_block_140 = CodeBlock { _InputDic2; }  # unwired: InputDic2
count_19 = List.Count(list=code_block_140)
code_block_141 = CodeBlock { _InputDic1; }  # unwired: InputDic1
code_block_142 = CodeBlock { "TargetWMunique"; }
valueAtKey_30 = DesignScript.Builtin.Dictionary.ValueAtKey(dictionary=code_block_141, key=code_block_142)
watch_9 = Watch(valueAtKey_30)
count_20 = List.Count(list=watch_9)
eq_2 = count_19 == count_20
organizeFuncValuesAndWorkMasterAsDiction_2 = Custom[OrganizeFuncValuesAndWorkMasterAsDictionary](InputDic1=code_block_141, InputDic2=code_block_140)
watch_10 = Watch()  # unwired: arg0
if_5 = If(test=eq_2, true=organizeFuncValuesAndWorkMasterAsDiction_2, false=watch_10)

# group: 데이터 취합 및 Row 방향 정렬
code_block_143 = CodeBlock(InputDic=if_5) { _InputDic; }
code_block_144 = CodeBlock { "TrTargetFamilyCode"; }
valueAtKey_31 = DesignScript.Builtin.Dictionary.ValueAtKey(dictionary=code_block_143, key=code_block_144)
watch_11 = Watch(valueAtKey_31)
flatten_32 = List.Flatten(list=watch_11)
code_block_145 = CodeBlock { "WMforTargetElements"; }
valueAtKey_32 = DesignScript.Builtin.Dictionary.ValueAtKey(dictionary=code_block_143, key=code_block_145)
watch_12 = Watch(valueAtKey_32)
flatten_33 = List.Flatten(list=watch_12)
code_block_146 = CodeBlock { "TargetFuncValues"; }
valueAtKey_33 = DesignScript.Builtin.Dictionary.ValueAtKey(dictionary=code_block_143, key=code_block_146)
watch_13 = Watch(valueAtKey_33)
flatten_34 = List.Flatten(list=watch_13)
code_block_147 = CodeBlock { "TargetFuncValuesUnit"; }
valueAtKey_34 = DesignScript.Builtin.Dictionary.ValueAtKey(dictionary=code_block_143, key=code_block_147)
watch_14 = Watch(valueAtKey_34)
flatten_35 = List.Flatten(list=watch_14)
list_create_6 = List.Create(item0=flatten_32, item1=flatten_33, item2=flatten_34, item3=flatten_35)
transpose_6 = List.Transpose(lists=list_create_6)

area_6 = Surface.Area(surface=extractUpperFacesOfElement.Surface)
sum_4 = Math.Sum(values=area_6)
code_block_148 = CodeBlock(i=sum_4) { Math.Round(List.Flatten(i)/1000000, 2); }
code_block_149 = CodeBlock { "M3"; }
count_21 = List.Count(list=code_block_148)
ofRepeatedItem_16 = List.OfRepeatedItem(item=code_block_149, amount=count_21)
code_block_150 = CodeBlock(FuncValues=code_block_148, FuncValuesUnit=ofRepeatedItem_16)  # same code as code_block_20
code_block_151 = CodeBlock { "TargetElements"; }
valueAtKey_35 = DesignScript.Builtin.Dictionary.ValueAtKey(dictionary=code_block_47, key=code_block_151)
code_block_152 = CodeBlock { "Volume"; }
getParameterValueByName_6 = Element.GetParameterValueByName(element=valueAtKey_35, parameterName=code_block_152)
code_block_153 = CodeBlock(i=getParameterValueByName_6) { Math.Round(List.Flatten(i)/1000000, 2); }
code_block_154 = CodeBlock { "M3"; }
count_22 = List.Count(list=code_block_153)
ofRepeatedItem_17 = List.OfRepeatedItem(item=code_block_154, amount=count_22)
code_block_155 = CodeBlock(FuncValues=code_block_153, FuncValuesUnit=ofRepeatedItem_17)  # same code as code_block_20
code_block_156 = CodeBlock { "TargetElements"; }
valueAtKey_36 = DesignScript.Builtin.Dictionary.ValueAtKey(dictionary=code_block_48, key=code_block_156)
createLeanConcrete_5 = Custom[CreateLeanConcrete](Element=valueAtKey_36)
area_7 = Surface.Area(surface=createLeanConcrete_5.Surface)
code_block_157 = CodeBlock(i=area_7) { Math.Round(List.Flatten(i)/1000000, 2); }
code_block_158 = CodeBlock { "M2"; }
count_23 = List.Count(list=code_block_157)
ofRepeatedItem_18 = List.OfRepeatedItem(item=code_block_158, amount=count_23)
code_block_159 = CodeBlock(FuncValues=code_block_157, FuncValuesUnit=ofRepeatedItem_18)  # same code as code_block_20
map = List.Map()  # unwired: list, function
isNull_3 = Object.IsNull(object=createExcavationSolid.Solid)
code_block_160 = CodeBlock { 1; }
mul_2 = _ * code_block_160  # unwired: x
volume_8 = Solid.Volume()  # unwired: solid
if_6 = If(test=isNull_3, true=mul_2, false=volume_8)
code_block_161 = CodeBlock { 0; }
isNull_4 = Object.IsNull()  # unwired: object
replaceByCondition_3 = Replace(item=createExcavationSolid.Solid, replaceWith=code_block_161, condition=isNull_4)
laceShortest = List.LaceShortest(combineFunction=map, list0=if_6, list1=replaceByCondition_3)
code_block_162 = CodeBlock(i=laceShortest) { Math.Round(List.Flatten(i)/1000000000, 2); }
code_block_163 = CodeBlock { "M3"; }
count_24 = List.Count(list=code_block_162)
ofRepeatedItem_19 = List.OfRepeatedItem(item=code_block_163, amount=count_24)
code_block_164 = CodeBlock(FuncValues=code_block_162, FuncValuesUnit=ofRepeatedItem_19)  # same code as code_block_20
code_block_165 = CodeBlock { 0; }
code_block_166 = CodeBlock { "TargetElements"; }
valueAtKey_37 = DesignScript.Builtin.Dictionary.ValueAtKey(dictionary=code_block_49, key=code_block_166)
count_25 = List.Count(list=valueAtKey_37@L1)
ofRepeatedItem_20 = List.OfRepeatedItem(item=code_block_165, amount=count_25)
code_block_167 = CodeBlock(i=ofRepeatedItem_20) { Math.Round(List.Flatten(i)/1000000000, 2); }
code_block_168 = CodeBlock { "M3"; }
count_26 = List.Count(list=code_block_167)
ofRepeatedItem_21 = List.OfRepeatedItem(item=code_block_168, amount=count_26)
code_block_169 = CodeBlock(FuncValues=code_block_167, FuncValuesUnit=ofRepeatedItem_21)  # same code as code_block_20
code_block_170 = CodeBlock { 0; }
code_block_171 = CodeBlock { "TargetElements"; }
valueAtKey_38 = DesignScript.Builtin.Dictionary.ValueAtKey(dictionary=code_block_50, key=code_block_171)
count_27 = List.Count(list=valueAtKey_38@L1)
ofRepeatedItem_22 = List.OfRepeatedItem(item=code_block_170, amount=count_27)
code_block_172 = CodeBlock(i=ofRepeatedItem_22) { Math.Round(List.Flatten(i)/1000000000, 2); }
code_block_173 = CodeBlock { "M3"; }
count_28 = List.Count(list=code_block_172)
ofRepeatedItem_23 = List.OfRepeatedItem(item=code_block_173, amount=count_28)
code_block_174 = CodeBlock(FuncValues=code_block_172, FuncValuesUnit=ofRepeatedItem_23)  # same code as code_block_20
area_8 = Surface.Area(surface=createBaseCourseSurfaces.Surface)
code_block_175 = CodeBlock(i=area_8) { Math.Round(List.Flatten(i)/1000000, 2); }
code_block_176 = CodeBlock { "M2"; }
count_29 = List.Count(list=code_block_175)
ofRepeatedItem_24 = List.OfRepeatedItem(item=code_block_176, amount=count_29)
code_block_177 = CodeBlock(FuncValues=code_block_175, FuncValuesUnit=ofRepeatedItem_24)  # same code as code_block_20
code_block_178 = CodeBlock { 0; }
code_block_179 = CodeBlock { "TargetElements"; }
valueAtKey_39 = DesignScript.Builtin.Dictionary.ValueAtKey(dictionary=code_block_51, key=code_block_179)
count_30 = List.Count(list=valueAtKey_39@L1)
ofRepeatedItem_25 = List.OfRepeatedItem(item=code_block_178, amount=count_30)
code_block_180 = CodeBlock(i=ofRepeatedItem_25) { Math.Round(List.Flatten(i)/1000000000, 2); }
code_block_181 = CodeBlock { "M3"; }
count_31 = List.Count(list=code_block_180)
ofRepeatedItem_26 = List.OfRepeatedItem(item=code_block_181, amount=count_31)
code_block_182 = CodeBlock(FuncValues=code_block_180, FuncValuesUnit=ofRepeatedItem_26)  # same code as code_block_20
volume_9 = Solid.Volume(solid=createLeanConcrete_2.Solid)
code_block_183 = CodeBlock(i=volume_9) { Math.Round(List.Flatten(i)/1000000000, 2); }
code_block_184 = CodeBlock { "M3"; }
count_32 = List.Count(list=code_block_183)
ofRepeatedItem_27 = List.OfRepeatedItem(item=code_block_184, amount=count_32)
code_block_185 = CodeBlock(FuncValues=code_block_183, FuncValuesUnit=ofRepeatedItem_27)  # same code as code_block_20
code_block_186 = CodeBlock { "TargetElements"; }
valueAtKey_40 = DesignScript.Builtin.Dictionary.ValueAtKey(dictionary=code_block_52, key=code_block_186)
code_block_187 = CodeBlock { "Volume"; }
getParameterValueByName_7 = Element.GetParameterValueByName(element=valueAtKey_40, parameterName=code_block_187)
code_block_188 = CodeBlock { 0.1; }
mul_3 = getParameterValueByName_7 * code_block_188
code_block_189 = CodeBlock(i=mul_3) { Math.Round(List.Flatten(i)/1, 2); }
code_block_190 = CodeBlock { "TON"; }
count_33 = List.Count(list=code_block_189)
ofRepeatedItem_28 = List.OfRepeatedItem(item=code_block_190, amount=count_33)
code_block_191 = CodeBlock(FuncValues=code_block_189, FuncValuesUnit=ofRepeatedItem_28)  # same code as code_block_20
join_2 = List.Join(list0=code_block_150, list1=code_block_155, list2=code_block_57, list3=code_block_159, list4=code_block_164, list5=code_block_169, list6=code_block_174, list7=code_block_177, list8=code_block_182, list9=code_block_185, list10=code_block_191)

# group: TargetWMunique + Data Sending
code_block_192 = CodeBlock(InputDic2=join_2) { _InputDic2; }
count_34 = List.Count(list=code_block_192)
code_block_193 = CodeBlock(InputDic1=code_block_37) { _InputDic1; }
code_block_194 = CodeBlock { "TargetWMunique"; }
valueAtKey_41 = DesignScript.Builtin.Dictionary.ValueAtKey(dictionary=code_block_193, key=code_block_194)
watch_15 = Watch(valueAtKey_41)
count_35 = List.Count(list=watch_15)
eq_3 = count_34 == count_35
organizeFuncValuesAndWorkMasterAsDiction_3 = Custom[OrganizeFuncValuesAndWorkMasterAsDictionary](InputDic1=code_block_193, InputDic2=code_block_192)
watch_16 = Watch()  # unwired: arg0
if_7 = If(test=eq_3, true=organizeFuncValuesAndWorkMasterAsDiction_3, false=watch_16)

# group: 데이터 취합 및 Row 방향 정렬
code_block_195 = CodeBlock(InputDic=if_7) { _InputDic; }
code_block_196 = CodeBlock { "TrTargetFamilyCode"; }
valueAtKey_42 = DesignScript.Builtin.Dictionary.ValueAtKey(dictionary=code_block_195, key=code_block_196)
watch_17 = Watch(valueAtKey_42)
flatten_36 = List.Flatten(list=watch_17)
code_block_197 = CodeBlock { "WMforTargetElements"; }
valueAtKey_43 = DesignScript.Builtin.Dictionary.ValueAtKey(dictionary=code_block_195, key=code_block_197)
watch_18 = Watch(valueAtKey_43)
flatten_37 = List.Flatten(list=watch_18)
code_block_198 = CodeBlock { "TargetFuncValues"; }
valueAtKey_44 = DesignScript.Builtin.Dictionary.ValueAtKey(dictionary=code_block_195, key=code_block_198)
watch_19 = Watch(valueAtKey_44)
flatten_38 = List.Flatten(list=watch_19)
code_block_199 = CodeBlock { "TargetFuncValuesUnit"; }
valueAtKey_45 = DesignScript.Builtin.Dictionary.ValueAtKey(dictionary=code_block_195, key=code_block_199)
watch_20 = Watch(valueAtKey_45)
flatten_39 = List.Flatten(list=watch_20)
list_create_7 = List.Create(item0=flatten_36, item1=flatten_37, item2=flatten_38, item3=flatten_39)
transpose_7 = List.Transpose(lists=list_create_7)

# group: 패밀리 별 취합 + Export Excel(By OpenpyXl)
# note: Excel Export Button
boolean = BoolSelector(false)
join_3 = List.Join(list0=transpose_5, list1=transpose_6, list2=transpose_7)
watch_21 = Watch()  # unwired: arg0
if_8 = If(test=boolean, true=join_3, false=watch_21)
python_script_export_excel_by = Python(IN[0]=if_8)  # "Python Script@Export Excel(By OpenpyXl)"; CPython3
# ---------- python_script_export_excel_by.python (151 lines) ----------
# Load the Python Standard and DesignScript Libraries
import sys
import os
#sys.path.append(r'C:\Users\HEC\AppData\Local\Programs\Python\Python39\Lib\site-packages')
#sys.path.append(r'C:\Users\pjmk0\AppData\Local\Programs\Python\Python39\Lib\site-packages')
sys.path.append(os.getenv('LOCALAPPDATA').replace('\\','\\\\') + r'\Programs\Python\Python39\Lib\site-packages')
import clr
clr.AddReference('ProtoGeometry')
from Autodesk.DesignScript.Geometry import *
from collections import Iterable

def iterable(obj):
    return isinstance(obj, Iterable)


# The inputs to this node will be stored as a list in the IN variables.
dataEnteringNode = IN
ListIn = IN[0]

# Place your code below this line
import datetime
from datetime import date, timedelta
Today = date.today()
import openpyxl
from openpyxl.styles import Border, Side, PatternFill, Font, GradientFill, Alignment, Color, numbers

sample_items = ListIn


def write_to_file(filepath):
    wb = openpyxl.Workbook()
    for sheet in wb.sheetnames:
        wb.remove(wb[sheet])

    thin = Side(border_style="thin", color="000000")
    double = Side(border_style="double", color="000000")

    ws = wb.create_sheet(title='Wall_Calc_instance', index=0)

    ws.merge_cells('A1:L1')
    ws['A1'] = 'HEC Wall Category Calculation Sheet'
    cell = ws['A1']
    cell.font = openpyxl.styles.Font(color='000000', size=20)
    cell.fill = openpyxl.styles.fills.PatternFill(patternType='solid',
                                                  fgColor=openpyxl.styles.colors.Color(rgb='fff3b0'))

    ws['A2'] = 'Item Number'
    ws['A2'].font = openpyxl.styles.Font(b=True, color='000000', size=12)
    #ws['B2'] = 'Member Name'
    #ws['B2'].font = openpyxl.styles.Font(b=True, color='000000', size=12)
    #ws['C2'] = 'Category'
    #ws['C2'].font = openpyxl.styles.Font(b=True, color='000000', size=12)
    ws['B2'] = 'Family Type'
    ws['B2'].font = openpyxl.styles.Font(b=True, color='000000', size=12)
    ws['C2'] = 'WorkMaster Code'
    ws['C2'].font = openpyxl.styles.Font(b=True, color='000000', size=12)
    #ws['F2'] = 'WorkMaster Description'
    #ws['F2'].font = openpyxl.styles.Font(b=True, color='000000', size=12)
    #ws['G2'] = 'Unit'
    #ws['G2'].font = openpyxl.styles.Font(b=True, color='000000', size=12)
    #ws['H2'] = '계수'
    #ws['H2'].font = openpyxl.styles.Font(b=True, color='000000', size=12)
    #ws['I2'] = '계산 참조값'
    #ws['I2'].font = openpyxl.styles.Font(b=True, color='000000', size=12)
    ws['D2'] = 'Quantities'
    ws['D2'].font = openpyxl.styles.Font(b=True, color='000000', size=12)
    ws['E2'] = 'Unit'
    ws['E2'].font = openpyxl.styles.Font(b=True, color='000000', size=12)
    ws['F2'] = 'Unit Price'
    ws['F2'].font = openpyxl.styles.Font(b=True, color='000000', size=12)
    ws['G2'] = 'Total Price'
    ws['G2'].font = openpyxl.styles.Font(b=True, color='000000', size=12)


## 칼럼별 너비 조정 구간
#    for col in range(ws.max_column):
#        ws.column_dimensions[chr(ord('A') + col)].width = 15
    ws.column_dimensions['A'].width = 15
    ws.column_dimensions['B'].width = 45
    ws.column_dimensions['C'].width = 60
    ws.column_dimensions['D'].width = 20
    ws.column_dimensions['E'].width = 20
    ws.column_dimensions['F'].width = 20
    ws.column_dimensions['G'].width = 20
    #ws.column_dimensions['G'].width = 9
    #ws.column_dimensions['H'].width = 9
    #ws.column_dimensions['H'].hidden = True
    #ws.column_dimensions['I'].width = 12
    #ws.column_dimensions['I'].hidden = True
    #ws.column_dimensions['J'].width = 12
    #ws.column_dimensions['K'].width = 12
    #ws.column_dimensions['L'].width = 12

###
    start_row = 3
    for (row, item) in enumerate(sample_items, start_row):
        cell = ws.cell(row=row, column=1, value=row - 2)
        cell.alignment = openpyxl.styles.Alignment(horizontal='center', vertical='center')

#        cell = ws.cell(row=row, column=2, value=item[0])
#        cell.number_format = openpyxl.styles.numbers.FORMAT_DATE_YYYYMMDD2  # 'yyyy-mm-dd'
        ws.cell(row=row, column=2, value=item[0]) ## Family Type 칼럼

        ws.cell(row=row, column=3, value=item[1]) ## WorkMaster Code 칼럼
        
        ws.cell(row=row, column=4, value=item[2]) ## Quantities 칼럼
        
        ws.cell(row=row, column=5, value=item[3]) ## Unit 칼럼
        
        #cell = ws.cell(row=row, column=8, value=item[6]) ## 계수 칼럼
        #cell.number_format = openpyxl.styles.numbers.builtin_format_code(3)  # '#,##0'
        
        #cell = ws.cell(row=row, column=9, value=item[7]) ## 계산 참조값 칼럼
        #cell.number_format = openpyxl.styles.numbers.builtin_format_code(3)  # '#,##0'
        
        #cell = ws.cell(row=row, column=10, value=item[8]) ## Quantities 칼럼
        #cell.number_format = openpyxl.styles.numbers.builtin_format_code(3)  # '#,##0'
        #cell.font = openpyxl.styles.Font(b=True, color='000000', size=11)

        cell = ws.cell(row=row, column=7, value='= D{current_row}*F{current_row}'.format(current_row=cell.row))
        cell.number_format = '#,##0'

#        cell = ws.cell(row=row, column=6, value='= D{current_row} * E{current_row}'.format(current_row=cell.row))
#        cell.number_format = openpyxl.styles.numbers.builtin_format_code(3)

    total_row = ws.max_row + 1
    if total_row > start_row:
        cell1 = ws.cell(row=total_row, column=6, value='Total')
        cell1.font = openpyxl.styles.Font(b=True, color='000000', size=15)
        
        cell2 = ws.cell(row=total_row, column=7, value='= SUM(G{}:G{})'.format(start_row, total_row - 1))
        cell2.number_format = openpyxl.styles.numbers.builtin_format_code(3)
        cell2.border = Border(top=double, left=double, right=double, bottom=double)
        cell2.font = openpyxl.styles.Font(b=True, color='ff03ce', size=15)
    

    wb.save(filepath)
    wb.close()


##if __name__ == '__main__':
#write_to_file('C:\\Users\\pjmk0\\AppData\\Roaming\\test.xlsx')

save_name = "HecStrFDNCalcSheet_" + Today.strftime("%Y-%m-%d")+".xlsx"
path = os.getenv('APPDATA').replace('\\','\\\\')
filePath = path + '\\' + save_name

write_to_file(filePath)

# Assign your output to the OUT variable.
OUT = os.getenv('APPDATA')
# ----------------------------------------

# group: <Func 1> Visual Manager
visual_켜기_끄기 = BoolSelector(true)
visual_manager = Python(IN[0]=output_5.RefOutput_geoColor, IN[1]=visual_켜기_끄기)  # CPython3
# ---------- visual_manager.python (18 lines) ----------
# Load the Python Standard and DesignScript Libraries
import sys
import clr
clr.AddReference('ProtoGeometry')
from Autodesk.DesignScript.Geometry import *

# The inputs to this node will be stored as a list in the IN variables.
dataEnteringNode = IN
geoColors = IN[0]
blnForVisual = IN[1]

# Place your code below this line
if blnForVisual == True:
    result = geoColors
else:
    result = 0
# Assign your output to the OUT variable.
OUT = result
# ----------------------------------------

# group: <Func 4> Visual Manager
visual_켜기_끄기_2 = BoolSelector(true)
visual_manager_2 = Python(IN[0]=output_8.RefOutput_geoColor, IN[1]=visual_켜기_끄기_2)  # CPython3; same code as visual_manager

# group: <Func 5> Visual Manager
visual_켜기_끄기_3 = BoolSelector(true)
visual_manager_3 = Python(IN[0]=output_4.RefOutput_geoColor, IN[1]=visual_켜기_끄기_3)  # CPython3; same code as visual_manager

# group: <Func 6> Visual Manager
visual_켜기_끄기_4 = BoolSelector(true)
visual_manager_4 = Python(IN[0]=output_9.RefOutput_geoColor, IN[1]=visual_켜기_끄기_4)  # CPython3; same code as visual_manager

# group: <Func 6> Visual Manager
visual_켜기_끄기_5 = BoolSelector(true)
visual_manager_5 = Python(IN[0]=output_12.RefOutput_geoColor, IN[1]=visual_켜기_끄기_5)  # CPython3; same code as visual_manager

# group: Input Manager
value_for_import_from_others_15 = CodeBlock(MainInput=code_block_15) { MainInput; RefInput1; RefInput2; }  # unwired: RefInput1, RefInput2

# group: <Func 0> Hardner Finish (상부면)
code_block_200 = CodeBlock { "TargetElements"; }
# note: <Func>
valueAtKey_46 = DesignScript.Builtin.Dictionary.ValueAtKey(dictionary=value_for_import_from_others_15.MainInput, key=code_block_200)
flatten_40 = List.Flatten(list=valueAtKey_46)
# note: 일반화 여지가 있음
# (형상처리구간 + 물량계산 + 데이터 매칭)
extractUpperFacesOfElement_3 = Custom[ExtractUpperFacesOfElement](Element=flatten_40)
area_9 = Surface.Area(surface=extractUpperFacesOfElement_3.Surface)
sum_5 = Math.Sum(values=area_9)
code_block_201 = CodeBlock(i=sum_5) { Math.Round(List.Flatten(i)/1000000, 2); }
code_block_202 = CodeBlock { "M2"; }
count_36 = List.Count(list=code_block_201)
ofRepeatedItem_29 = List.OfRepeatedItem(item=code_block_202, amount=count_36)
code_block_203 = CodeBlock(FuncValues=code_block_201, FuncValuesUnit=ofRepeatedItem_29)  # same code as code_block_20
color_palette_5 = ColorPalette({R: 30, G: 144, B: 255, A: 129})
byGeometryColor_5 = Modifiers.GeometryColor.ByGeometryColor(geometry=extractUpperFacesOfElement_3.Surface, color=color_palette_5)

# group: Output Manager
reference_output_13 = CodeBlock { ref; }  # unwired: ref
output_13 = CodeBlock(MainOutput=code_block_203, RefOutput_geoColor=byGeometryColor_5) { MainOutput; RefOutput_geoColor; }

# group: <Func 6> Visual Manager
visual_켜기_끄기_6 = BoolSelector(false)
visual_manager_6 = Python(IN[0]=output_13.RefOutput_geoColor, IN[1]=visual_켜기_끄기_6)  # CPython3; same code as visual_manager

# group: 사용된 패밀리 타입 종류 확인 구간
code_block_204 = CodeBlock { "FamilyCode"; }
valueAtKey_47 = DesignScript.Builtin.Dictionary.ValueAtKey(dictionary=organizeAllElementInformAsDictionary, key=code_block_204)
uniqueItems_3 = List.UniqueItems(list=valueAtKey_47)
watch_22 = Watch(uniqueItems_3)
code_block_205 = CodeBlock { "ElementType"; }
valueAtKey_48 = DesignScript.Builtin.Dictionary.ValueAtKey(dictionary=organizeAllElementInformAsDictionary, key=code_block_205)
uniqueItems_4 = List.UniqueItems(list=valueAtKey_48)
watch_23 = Watch(uniqueItems_4)

watch_24 = Watch(selectTargetFamilyInformAsDictionary)
components = DesignScript.Builtin.Dictionary.Components(dictionary=selectTargetFamilyInformAsDictionary)
watch_25 = Watch(components.values)
watch_26 = Watch(components.keys)
code_block_206 = CodeBlock(i=watch_26)
# ---------- code_block_206.designscript (2 lines) ----------
[i[0],
i[1]];
# ----------------------------------------

# group: Visual Manager
visual_켜기_끄기_7 = BoolSelector(false)
visual_manager_7 = Python(IN[0]=output_2.RefOutput_geoColor, IN[1]=visual_켜기_끄기_7)  # CPython3; same code as visual_manager

# group: Output Manager
reference_output_14 = CodeBlock { ref; }  # unwired: ref
output_14 = CodeBlock(MainOutput=code_block_36) { MainOutput; RefOutput_geoColor; }  # unwired: RefOutput_geoColor

# group: Visual Manager
visual_켜기_끄기_8 = BoolSelector(false)
visual_manager_8 = Python(IN[0]=output.RefOutput_geoColor, IN[1]=visual_켜기_끄기_8)  # CPython3; same code as visual_manager

# group: Input Manager
value_for_import_from_others_16 = CodeBlock(MainInput=code_block_15) { MainInput; RefInput1; RefInput2; }  # unwired: RefInput1, RefInput2

# group: <Func 1> Structural Concrete
code_block_207 = CodeBlock { "TargetElements"; }
valueAtKey_49 = DesignScript.Builtin.Dictionary.ValueAtKey(dictionary=value_for_import_from_others_16.MainInput, key=code_block_207)
# note: <Func>
geometry_3 = Element.Geometry(element=valueAtKey_49)
volume_10 = Solid.Volume(solid=geometry_3)
code_block_208 = CodeBlock(i=volume_10) { Math.Round(List.Flatten(i)/1000000000,2); }
code_block_209 = CodeBlock { "M3"; }
count_37 = List.Count(list=code_block_208)
ofRepeatedItem_30 = List.OfRepeatedItem(item=code_block_209, amount=count_37)
code_block_210 = CodeBlock(FuncValues=code_block_208, FuncValuesUnit=ofRepeatedItem_30)  # same code as code_block_20

# group: Output Manager
output_15 = CodeBlock(MainOutput=code_block_210) { MainOutput; RefOutput_geoColor; }  # unwired: RefOutput_geoColor
reference_output_15 = CodeBlock(ref=geometry_3) { ref; }

# group: Input Manager
value_for_import_from_others_17 = CodeBlock(MainInput=code_block_15) { MainInput; RefInput1; RefInput2; }  # unwired: RefInput1, RefInput2

# group: <Func 2> Form Works (Ground Slab 거푸집 필요X)
code_block_211 = CodeBlock { "TargetElements"; }
valueAtKey_50 = DesignScript.Builtin.Dictionary.ValueAtKey(dictionary=value_for_import_from_others_17.MainInput, key=code_block_211)
code_block_212 = CodeBlock { "Volume"; }
# note: <Func>
getParameterValueByName_8 = Element.GetParameterValueByName(element=valueAtKey_50, parameterName=code_block_212)
code_block_213 = CodeBlock(i=getParameterValueByName_8) { Math.Round(List.Flatten(i)/10000000,2); }
code_block_214 = CodeBlock { "M3"; }
count_38 = List.Count(list=code_block_213)
ofRepeatedItem_31 = List.OfRepeatedItem(item=code_block_214, amount=count_38)
code_block_215 = CodeBlock(FuncValues=code_block_213, FuncValuesUnit=ofRepeatedItem_31)  # same code as code_block_20

# group: Output Manager
reference_output_16 = CodeBlock { ref; }  # unwired: ref
output_16 = CodeBlock(MainOutput=code_block_215) { MainOutput; RefOutput_geoColor; }  # unwired: RefOutput_geoColor

# group: Input Manager
value_for_import_from_others_18 = CodeBlock(MainInput=code_block_15) { MainInput; RefInput1; RefInput2; }  # unwired: RefInput1, RefInput2

# group: <Func 3> PE Sheet
code_block_216 = CodeBlock { "TargetElements"; }
valueAtKey_51 = DesignScript.Builtin.Dictionary.ValueAtKey(dictionary=value_for_import_from_others_18.MainInput, key=code_block_216)
# note: <Func>
createLeanConcrete_6 = Custom[CreateLeanConcrete](Element=valueAtKey_51)
area_10 = Surface.Area(surface=createLeanConcrete_6.Surface)
code_block_217 = CodeBlock(i=area_10) { Math.Round(List.Flatten(i)/1000000, 2); }
code_block_218 = CodeBlock { "M2"; }
count_39 = List.Count(list=code_block_217)
ofRepeatedItem_32 = List.OfRepeatedItem(item=code_block_218, amount=count_39)
code_block_219 = CodeBlock(FuncValues=code_block_217, FuncValuesUnit=ofRepeatedItem_32)  # same code as code_block_20

# group: Output Manager
reference_output_17 = CodeBlock { ref; }  # unwired: ref
output_17 = CodeBlock(MainOutput=code_block_219) { MainOutput; RefOutput_geoColor; }  # unwired: RefOutput_geoColor

# group: Input Manager
value_for_import_from_others_19 = CodeBlock(MainInput=code_block_15, RefInput1=reference_output, RefInput2=reference_output_2.ref, RefInput3=reference_output_15) { MainInput; RefInput1; RefInput2; RefInput3; }

# group: <Func 2> Backfill
value_for_import_from_others_20 = CodeBlock(터파기형상=value_for_import_from_others_19.RefInput2) { 터파기형상; }
flatten_41 = List.Flatten(list=value_for_import_from_others_20)
volume_11 = Solid.Volume(solid=flatten_41)
watch_27 = Watch(volume_11)
code_block_220 = CodeBlock(i=watch_27) { Math.Round(List.Flatten(i)/1000000000, 2); }
code_block_221 = CodeBlock { "M3"; }
count_40 = List.Count(list=watch_27)
ofRepeatedItem_33 = List.OfRepeatedItem(item=code_block_221, amount=count_40)
# note: 터파기 물량ㅈ에서 콘크리트, 린 기둥 물량 빼기
code_block_222 = CodeBlock(FuncValues=code_block_220, FuncValuesUnit=ofRepeatedItem_33)  # same code as code_block_20
value_for_import_from_others_21 = CodeBlock(슬라브형상=value_for_import_from_others_19.RefInput3) { 슬라브형상; }
flatten_42 = List.Flatten(list=value_for_import_from_others_21)
doesIntersect_3 = Geometry.DoesIntersect(geometry=flatten_41, other=flatten_42, lacing=CrossProduct)
filterByBoolMask_2 = List.FilterByBoolMask(list=flatten_42, mask=doesIntersect_3@L2)
flatten_43 = List.Flatten(list=filterByBoolMask_2.in)

# group: Output Manager
reference_output_18 = CodeBlock { ref; }  # unwired: ref
output_18 = CodeBlock(MainOutput=code_block_222) { MainOutput; RefOutput_geoColor; }  # unwired: RefOutput_geoColor

# group: Input Manager
value_for_import_from_others_22 = CodeBlock(MainInput=code_block_15) { MainInput; RefInput1; RefInput2; }  # unwired: RefInput1, RefInput2

# group: <Func 7>Base Course
code_block_223 = CodeBlock { "TargetElements"; }
valueAtKey_52 = DesignScript.Builtin.Dictionary.ValueAtKey(dictionary=value_for_import_from_others_22.MainInput, key=code_block_223)
# note: <Func>
createBaseCourseSurfaces_3 = Custom[CreateBaseCourseSurfaces](Element=valueAtKey_52)
area_11 = Surface.Area(surface=createBaseCourseSurfaces_3.Surface)
code_block_224 = CodeBlock(i=area_11) { Math.Round(List.Flatten(i)/1000000, 2); }
code_block_225 = CodeBlock { "M2"; }
count_41 = List.Count(list=code_block_224)
ofRepeatedItem_34 = List.OfRepeatedItem(item=code_block_225, amount=count_41)
code_block_226 = CodeBlock(FuncValues=code_block_224, FuncValuesUnit=ofRepeatedItem_34)  # same code as code_block_20
code_block_227 = CodeBlock { 300; 100; }

# group: Output Manager
output_19 = CodeBlock(MainOutput=code_block_226) { MainOutput; RefOutput_geoColor; }  # unwired: RefOutput_geoColor
reference_output_19 = CodeBlock(ref=createBaseCourseSurfaces_3.Surface) { ref; }

# group: Input Manager
value_for_import_from_others_23 = CodeBlock(MainInput=code_block_15, RefInput1=reference_output_19) { MainInput; RefInput1; RefInput2; }  # unwired: RefInput2

# group: <Func 8>Crushed Stone
code_block_228 = CodeBlock { "TargetElements"; }
valueAtKey_53 = DesignScript.Builtin.Dictionary.ValueAtKey(dictionary=value_for_import_from_others_23.MainInput, key=code_block_228)
createBaseCourseSurfaces_4 = Custom[CreateBaseCourseSurfaces](Element=valueAtKey_53)
# note: <Func>
code_block_229 = CodeBlock { 300; 100; }
boolean_2 = BoolSelector(false)
thicken = Surface.Thicken(surface=createBaseCourseSurfaces_4.Surface, thickness=code_block_229.out0, both_sides=boolean_2)
volume_12 = Solid.Volume(solid=thicken)
code_block_230 = CodeBlock(i=volume_12) { Math.Round(List.Flatten(i)/1000000000, 2); }
code_block_231 = CodeBlock { "M3"; }
count_42 = List.Count(list=code_block_230)
ofRepeatedItem_35 = List.OfRepeatedItem(item=code_block_231, amount=count_42)
code_block_232 = CodeBlock(FuncValues=code_block_230, FuncValuesUnit=ofRepeatedItem_35)  # same code as code_block_20

# group: Output Manager
reference_output_20 = CodeBlock { ref; }  # unwired: ref
output_20 = CodeBlock(MainOutput=code_block_232) { MainOutput; RefOutput_geoColor; }  # unwired: RefOutput_geoColor

# group: Input Manager
value_for_import_from_others_24 = CodeBlock(MainInput=code_block_15) { MainInput; RefInput1; RefInput2; }  # unwired: RefInput1, RefInput2

# group: <Func 10>Rebar Work
code_block_233 = CodeBlock { "TargetElements"; }
valueAtKey_54 = DesignScript.Builtin.Dictionary.ValueAtKey(dictionary=value_for_import_from_others_24.MainInput, key=code_block_233)
code_block_234 = CodeBlock { "Volume"; }
# note: <Func>
getParameterValueByName_9 = Element.GetParameterValueByName(element=valueAtKey_54, parameterName=code_block_234)
sog_철근비 = DoubleInput(0)  # graph input
mul_4 = getParameterValueByName_9 * sog_철근비
code_block_235 = CodeBlock(i=mul_4) { Math.Round(List.Flatten(i)/1, 2); }
code_block_236 = CodeBlock { "TON"; }
count_43 = List.Count(list=code_block_235)
ofRepeatedItem_36 = List.OfRepeatedItem(item=code_block_236, amount=count_43)
code_block_237 = CodeBlock(FuncValues=code_block_235, FuncValuesUnit=ofRepeatedItem_36)  # same code as code_block_20

# group: Output Manager
reference_output_21 = CodeBlock { ref; }  # unwired: ref
output_21 = CodeBlock(MainOutput=code_block_237) { MainOutput; RefOutput_geoColor; }  # unwired: RefOutput_geoColor

join_4 = List.Join(list0=output_13.MainOutput, list1=output_15.MainOutput, list2=output_16.MainOutput, list3=output_17.MainOutput, list4=output_2.MainOutput, list5=output_18.MainOutput, list6=output_14.MainOutput, list7=output_19.MainOutput, list8=output_20.MainOutput, list9=output.MainOutput, list10=output_21.MainOutput)

# group: TargetWMunique + Data Sending
code_block_238 = CodeBlock(InputDic2=join_4) { _InputDic2; }
count_44 = List.Count(list=code_block_238)
code_block_239 = CodeBlock(InputDic1=selectTargetFamilyInformAsDictionary) { _InputDic1; }
code_block_240 = CodeBlock { "TargetWMunique"; }
valueAtKey_55 = DesignScript.Builtin.Dictionary.ValueAtKey(dictionary=code_block_239, key=code_block_240)
watch_28 = Watch(valueAtKey_55)
count_45 = List.Count(list=watch_28)
eq_4 = count_44 == count_45
organizeFuncValuesAndWorkMasterAsDiction_4 = Custom[OrganizeFuncValuesAndWorkMasterAsDictionary](InputDic1=code_block_239, InputDic2=code_block_238)
watch_29 = Watch()  # unwired: arg0
if_9 = If(test=eq_4, true=organizeFuncValuesAndWorkMasterAsDiction_4, false=watch_29)

watch_30 = Watch(output_2.MainOutput)

# group: 하위분개
keys_2 = DesignScript.Builtin.Dictionary.Keys(dictionary=selectTargetFamilyInformAsDictionary)
code_block_241 = CodeBlock(i=keys_2) { i; }
valueAtKey_56 = DesignScript.Builtin.Dictionary.ValueAtKey(dictionary=selectTargetFamilyInformAsDictionary, key=keys_2)
code_block_242 = CodeBlock { -1; }
dropItems_2 = List.DropItems(list=valueAtKey_56, amount=code_block_242)
code_block_243 = CodeBlock { 0; }
code_block_244 = CodeBlock(i=dropItems_2) { i[0]; i[1]; i[2]; }
flatten_44 = List.Flatten(list=code_block_244.out0)
replaceItemAtIndex_4 = List.ReplaceItemAtIndex(list=dropItems_2, index=code_block_243, item=flatten_44)
code_block_245 = CodeBlock { 1; }
flatten_45 = List.Flatten(list=code_block_244.out1@L2)
replaceItemAtIndex_5 = List.ReplaceItemAtIndex(list=replaceItemAtIndex_4, index=code_block_245, item=flatten_45)
code_block_246 = CodeBlock { 2; }
flatten_46 = List.Flatten(list=code_block_244.out2)
replaceItemAtIndex_6 = List.ReplaceItemAtIndex(list=replaceItemAtIndex_5, index=code_block_246, item=flatten_46)
분개_index_입력_2 = CodeBlock { [1,2,3]; }
getItemAtIndex_2 = List.GetItemAtIndex(list=replaceItemAtIndex_6@L3, index=분개_index_입력_2)
code_block_247 = CodeBlock(i=getItemAtIndex_2) { i[1]; }
flatten_47 = List.Flatten(list=code_block_247)
uniqueItems_5 = List.UniqueItems(list=flatten_47)
addItemToEnd_2 = List.AddItemToEnd(item=uniqueItems_5, list=getItemAtIndex_2)
byKeysValues_4 = DesignScript.Builtin.Dictionary.ByKeysValues(keys=code_block_241, values=addItemToEnd_2)

code_block_248 = CodeBlock(i=byKeysValues_4) { i; }

# group: Input Manager
value_for_import_from_others_25 = CodeBlock(MainInput=code_block_248) { MainInput; RefInput1; RefInput2; }  # unwired: RefInput1, RefInput2

# group: <Func 9>Lean Concrete
code_block_249 = CodeBlock { "TargetElements"; }
valueAtKey_57 = DesignScript.Builtin.Dictionary.ValueAtKey(dictionary=value_for_import_from_others_25.MainInput, key=code_block_249)
code_block_250 = CodeBlock { 0; 100; }
# note: <Func>
createLeanConcrete_7 = Custom[CreateLeanConcrete](Element=valueAtKey_57, leanOffset=code_block_250.out0, leanThick=code_block_250.out1)
volume_13 = Solid.Volume(solid=createLeanConcrete_7.Solid)
code_block_251 = CodeBlock(i=volume_13) { Math.Round(List.Flatten(i)/1000000000, 2); }
code_block_252 = CodeBlock { "M3"; }
count_46 = List.Count(list=code_block_251)
ofRepeatedItem_37 = List.OfRepeatedItem(item=code_block_252, amount=count_46)
code_block_253 = CodeBlock(FuncValues=code_block_251, FuncValuesUnit=ofRepeatedItem_37)  # same code as code_block_20

# group: Output Manager
reference_output_22 = CodeBlock(ref=createLeanConcrete_7.Solid) { ref; }
output_22 = CodeBlock(MainOutput=code_block_253, RefOutput_geoColor=createLeanConcrete_7.Solid) { MainOutput; RefOutput_geoColor; }

# group: Input Manager
value_for_import_from_others_26 = CodeBlock(MainInput=code_block_248, RefInput1=reference_output_22) { MainInput; RefInput1; RefInput2; }  # unwired: RefInput2

# group: <Func 4> Excavation (SOG 한정)
flatten_48 = List.Flatten(list=value_for_import_from_others_26.RefInput1)
하부_surface_추출_5 = Python(IN[0]=flatten_48)  # CPython3; same code as 하부_surface_추출
flatten_49 = List.Flatten(list=하부_surface_추출_5)
perimeterCurves_4 = Surface.PerimeterCurves(surface=flatten_49)
byJoinedCurves_4 = PolyCurve.ByJoinedCurves(curves=perimeterCurves_4)
code_block_254 = CodeBlock { _ExcavOffsetBottom: var[]..[] = 300; }
offset_7 = Curve.Offset(curve=byJoinedCurves_4, distance=code_block_254)
flatten_50 = List.Flatten(list=offset_7)
levels_4 = Levels("G.L")  # graph input
elevation_4 = Level.Elevation(level=levels_4)
code_block_255 = CodeBlock { "TargetElements"; }
valueAtKey_58 = DesignScript.Builtin.Dictionary.ValueAtKey(dictionary=value_for_import_from_others_26.MainInput, key=code_block_255)
code_block_256 = CodeBlock { "Elevation at Bottom"; }
getParameterValueByName_10 = Element.GetParameterValueByName(element=valueAtKey_58, parameterName=code_block_256)
린_콘크리트_하부까지의_길이_추출_최하단_4 = Python(IN[0]=value_for_import_from_others_26.RefInput1)  # CPython3; same code as 린_콘크리트_하부까지의_길이_추출_최하단
code_block_257 = CodeBlock(기초하단=getParameterValueByName_10, 린콘크리트하단=린_콘크리트_하부까지의_길이_추출_최하단_4) { 기초하단-린콘크리트하단; }
sub_4 = elevation_4 - code_block_257
flatten_51 = List.Flatten(list=sub_4)
translate_4 = Geometry.Translate(geometry=offset_7, zTranslation=flatten_51)
경사_비율_입력_1_x_for_isofdn_3 = DoubleInput(2)  # graph input
code_block_258 = CodeBlock(ElevationatBottom=flatten_51, 비율=경사_비율_입력_1_x_for_isofdn_3) { ElevationatBottom/비율; }
offset_8 = Curve.Offset(curve=translate_4, distance=code_block_258)
flatten_52 = List.Flatten(list=offset_8)
list_create_8 = List.Create(item0=flatten_50, item1=flatten_52)
transpose_8 = List.Transpose(lists=list_create_8)
byLoft_4 = Solid.ByLoft(crossSections=transpose_8)
터파기_형상_겹침_해소_4 = Python(IN[0]=byLoft_4)  # CPython3; same code as 터파기_형상_겹침_해소
code_block_259 = CodeBlock(i=sub_4) { i<0?true:false; }
code_block_260 = CodeBlock { 0; }
volume_14 = Solid.Volume(solid=터파기_형상_겹침_해소_4)
code_block_261 = CodeBlock(i=volume_14) { Math.Round(List.Flatten(i)/1000000000, 2); }
if_10 = If(test=code_block_259, true=code_block_260, false=code_block_261)
code_block_262 = CodeBlock { "M3"; }
count_47 = List.Count(list=code_block_261)
ofRepeatedItem_38 = List.OfRepeatedItem(item=code_block_262, amount=count_47)
code_block_263 = CodeBlock(FuncValues=if_10, FuncValuesUnit=ofRepeatedItem_38)  # same code as code_block_20
color_palette_6 = ColorPalette({R: 210, G: 105, B: 30, A: 135})
byGeometryColor_6 = Modifiers.GeometryColor.ByGeometryColor(geometry=터파기_형상_겹침_해소_4, color=color_palette_6)
forRefOutput_4 = CodeBlock(MainOutput=code_block_263, geoColor=byGeometryColor_6, 터파기형상=터파기_형상_겹침_해소_4)  # same code as forRefOutput

# group: Output Manager
reference_output_23 = CodeBlock(ref=터파기_형상_겹침_해소_4, ref2=if_10) { ref; ref2; }
output_23 = CodeBlock(MainOutput=forRefOutput_4, RefOutput_geoColor=byGeometryColor_6) { MainOutput; RefOutput_geoColor; }

# group: Input Manager
value_for_import_from_others_27 = CodeBlock(MainInput=code_block_248, RefInput1=reference_output_23.ref2) { MainInput; RefInput1; RefInput2; }  # unwired: RefInput2

# group: <Func 6>Disposal
code_block_264 = CodeBlock { "TargetElements"; }
valueAtKey_59 = DesignScript.Builtin.Dictionary.ValueAtKey(dictionary=value_for_import_from_others_27.MainInput, key=code_block_264)
count_48 = List.Count(list=valueAtKey_59@L1)
code_block_265 = CodeBlock(i=value_for_import_from_others_27.RefInput1) { i==0?true:false; }
code_block_266 = CodeBlock { 0; }
# note: <Func>
if_11 = If(test=code_block_265, true=code_block_266, false=value_for_import_from_others_27.RefInput1)
code_block_267 = CodeBlock(i=if_11) { Math.Round(List.Flatten(i)/1000000000, 2); }
code_block_268 = CodeBlock { "M3"; }
count_49 = List.Count(list=code_block_267)
ofRepeatedItem_39 = List.OfRepeatedItem(item=code_block_268, amount=count_49)
code_block_269 = CodeBlock(FuncValues=code_block_267, FuncValuesUnit=ofRepeatedItem_39)  # same code as code_block_20

# group: Input Manager
value_for_import_from_others_28 = CodeBlock(MainInput=code_block_248) { MainInput; RefInput1; RefInput2; }  # unwired: RefInput1, RefInput2

# group: <Func 0> Hardner Finish (상부면)
code_block_270 = CodeBlock { "TargetElements"; }
# note: <Func>
valueAtKey_60 = DesignScript.Builtin.Dictionary.ValueAtKey(dictionary=value_for_import_from_others_28.MainInput, key=code_block_270)
flatten_53 = List.Flatten(list=valueAtKey_60)
# note: 일반화 여지가 있음
# (형상처리구간 + 물량계산 + 데이터 매칭)
extractUpperFacesOfElement_4 = Custom[ExtractUpperFacesOfElement](Element=flatten_53)
area_12 = Surface.Area(surface=extractUpperFacesOfElement_4.Surface)
sum_6 = Math.Sum(values=area_12)
code_block_271 = CodeBlock(i=sum_6) { Math.Round(List.Flatten(i)/1000000, 2); }
code_block_272 = CodeBlock { "M2"; }
count_50 = List.Count(list=code_block_271)
ofRepeatedItem_40 = List.OfRepeatedItem(item=code_block_272, amount=count_50)
code_block_273 = CodeBlock(FuncValues=code_block_271, FuncValuesUnit=ofRepeatedItem_40)  # same code as code_block_20
color_palette_7 = ColorPalette({R: 30, G: 144, B: 255, A: 129})
byGeometryColor_7 = Modifiers.GeometryColor.ByGeometryColor(geometry=extractUpperFacesOfElement_4.Surface, color=color_palette_7)

# group: Output Manager
reference_output_24 = CodeBlock { ref; }  # unwired: ref
output_24 = CodeBlock(MainOutput=code_block_273, RefOutput_geoColor=byGeometryColor_7) { MainOutput; RefOutput_geoColor; }

# group: <Func 6> Visual Manager
visual_켜기_끄기_9 = BoolSelector(false)
visual_manager_9 = Python(IN[0]=output_24.RefOutput_geoColor, IN[1]=visual_켜기_끄기_9)  # CPython3; same code as visual_manager

# group: Visual Manager
visual_켜기_끄기_10 = BoolSelector(false)
visual_manager_10 = Python(IN[0]=output_23.RefOutput_geoColor, IN[1]=visual_켜기_끄기_10)  # CPython3; same code as visual_manager

# group: Output Manager
reference_output_25 = CodeBlock { ref; }  # unwired: ref
output_25 = CodeBlock(MainOutput=code_block_269) { MainOutput; RefOutput_geoColor; }  # unwired: RefOutput_geoColor

# group: Input Manager
value_for_import_from_others_29 = CodeBlock(MainInput=code_block_248) { MainInput; RefInput1; RefInput2; }  # unwired: RefInput1, RefInput2

# group: <Func 1> Structural Concrete
code_block_274 = CodeBlock { "TargetElements"; }
valueAtKey_61 = DesignScript.Builtin.Dictionary.ValueAtKey(dictionary=value_for_import_from_others_29.MainInput, key=code_block_274)
# note: <Func>
geometry_4 = Element.Geometry(element=valueAtKey_61)
volume_15 = Solid.Volume(solid=geometry_4)
code_block_275 = CodeBlock(i=volume_15) { Math.Round(List.Flatten(i)/1000000000,2); }
code_block_276 = CodeBlock { "M3"; }
count_51 = List.Count(list=code_block_275)
ofRepeatedItem_41 = List.OfRepeatedItem(item=code_block_276, amount=count_51)
code_block_277 = CodeBlock(FuncValues=code_block_275, FuncValuesUnit=ofRepeatedItem_41)  # same code as code_block_20

# group: Output Manager
reference_output_26 = CodeBlock(ref=geometry_4) { ref; }
output_26 = CodeBlock(MainOutput=code_block_277) { MainOutput; RefOutput_geoColor; }  # unwired: RefOutput_geoColor

# group: Input Manager
value_for_import_from_others_30 = CodeBlock(MainInput=code_block_248, RefInput1=reference_output_22, RefInput2=reference_output_23.ref, RefInput3=reference_output_26) { MainInput; RefInput1; RefInput2; RefInput3; }

# group: <Func 2> Backfill
value_for_import_from_others_31 = CodeBlock(슬라브형상=value_for_import_from_others_30.RefInput3) { 슬라브형상; }
flatten_54 = List.Flatten(list=value_for_import_from_others_31)
value_for_import_from_others_32 = CodeBlock(터파기형상=value_for_import_from_others_30.RefInput2) { 터파기형상; }
flatten_55 = List.Flatten(list=value_for_import_from_others_32)
doesIntersect_4 = Geometry.DoesIntersect(geometry=flatten_55, other=flatten_54, lacing=CrossProduct)
filterByBoolMask_3 = List.FilterByBoolMask(list=flatten_54, mask=doesIntersect_4@L2)
flatten_56 = List.Flatten(list=filterByBoolMask_3.in)
volume_16 = Solid.Volume(solid=flatten_55)
watch_31 = Watch(volume_16)
code_block_278 = CodeBlock(i=watch_31) { Math.Round(List.Flatten(i)/1000000000, 2); }
code_block_279 = CodeBlock { "M3"; }
count_52 = List.Count(list=watch_31)
ofRepeatedItem_42 = List.OfRepeatedItem(item=code_block_279, amount=count_52)
# note: 터파기 물량ㅈ에서 콘크리트, 린 기둥 물량 빼기
code_block_280 = CodeBlock(FuncValues=code_block_278, FuncValuesUnit=ofRepeatedItem_42)  # same code as code_block_20

# group: Output Manager
reference_output_27 = CodeBlock { ref; }  # unwired: ref
output_27 = CodeBlock(MainOutput=code_block_280) { MainOutput; RefOutput_geoColor; }  # unwired: RefOutput_geoColor

watch_32 = Watch(output_23.MainOutput)

# group: Visual Manager
visual_켜기_끄기_11 = BoolSelector(false)
visual_manager_11 = Python(IN[0]=output_22.RefOutput_geoColor, IN[1]=visual_켜기_끄기_11)  # CPython3; same code as visual_manager

# group: Input Manager
value_for_import_from_others_33 = CodeBlock(MainInput=code_block_248) { MainInput; RefInput1; RefInput2; }  # unwired: RefInput1, RefInput2

# group: <Func 2> Form Works (Ground Slab 거푸집 필요X)
code_block_281 = CodeBlock { "TargetElements"; }
valueAtKey_62 = DesignScript.Builtin.Dictionary.ValueAtKey(dictionary=value_for_import_from_others_33.MainInput, key=code_block_281)
code_block_282 = CodeBlock { "Volume"; }
# note: <Func>
getParameterValueByName_11 = Element.GetParameterValueByName(element=valueAtKey_62, parameterName=code_block_282)
code_block_283 = CodeBlock(i=getParameterValueByName_11) { Math.Round(List.Flatten(i)/10000000,2); }
code_block_284 = CodeBlock { "M3"; }
count_53 = List.Count(list=code_block_283)
ofRepeatedItem_43 = List.OfRepeatedItem(item=code_block_284, amount=count_53)
code_block_285 = CodeBlock(FuncValues=code_block_283, FuncValuesUnit=ofRepeatedItem_43)  # same code as code_block_20

# group: Output Manager
reference_output_28 = CodeBlock { ref; }  # unwired: ref
output_28 = CodeBlock(MainOutput=code_block_285) { MainOutput; RefOutput_geoColor; }  # unwired: RefOutput_geoColor

# group: Input Manager
value_for_import_from_others_34 = CodeBlock(MainInput=code_block_248) { MainInput; RefInput1; RefInput2; }  # unwired: RefInput1, RefInput2

# group: <Func 3> PE Sheet
code_block_286 = CodeBlock { "TargetElements"; }
valueAtKey_63 = DesignScript.Builtin.Dictionary.ValueAtKey(dictionary=value_for_import_from_others_34.MainInput, key=code_block_286)
# note: <Func>
createLeanConcrete_8 = Custom[CreateLeanConcrete](Element=valueAtKey_63)
area_13 = Surface.Area(surface=createLeanConcrete_8.Surface)
code_block_287 = CodeBlock(i=area_13) { Math.Round(List.Flatten(i)/1000000, 2); }
code_block_288 = CodeBlock { "M2"; }
count_54 = List.Count(list=code_block_287)
ofRepeatedItem_44 = List.OfRepeatedItem(item=code_block_288, amount=count_54)
code_block_289 = CodeBlock(FuncValues=code_block_287, FuncValuesUnit=ofRepeatedItem_44)  # same code as code_block_20

# group: Output Manager
reference_output_29 = CodeBlock { ref; }  # unwired: ref
output_29 = CodeBlock(MainOutput=code_block_289) { MainOutput; RefOutput_geoColor; }  # unwired: RefOutput_geoColor

# group: Input Manager
value_for_import_from_others_35 = CodeBlock(MainInput=code_block_248) { MainInput; RefInput1; RefInput2; }  # unwired: RefInput1, RefInput2

# group: <Func 7>Base Course
code_block_290 = CodeBlock { "TargetElements"; }
valueAtKey_64 = DesignScript.Builtin.Dictionary.ValueAtKey(dictionary=value_for_import_from_others_35.MainInput, key=code_block_290)
# note: <Func>
createBaseCourseSurfaces_5 = Custom[CreateBaseCourseSurfaces](Element=valueAtKey_64)
area_14 = Surface.Area(surface=createBaseCourseSurfaces_5.Surface)
code_block_291 = CodeBlock(i=area_14) { Math.Round(List.Flatten(i)/1000000, 2); }
code_block_292 = CodeBlock { "M2"; }
count_55 = List.Count(list=code_block_291)
ofRepeatedItem_45 = List.OfRepeatedItem(item=code_block_292, amount=count_55)
code_block_293 = CodeBlock(FuncValues=code_block_291, FuncValuesUnit=ofRepeatedItem_45)  # same code as code_block_20
code_block_294 = CodeBlock { 300; 100; }

# group: Output Manager
output_30 = CodeBlock(MainOutput=code_block_293) { MainOutput; RefOutput_geoColor; }  # unwired: RefOutput_geoColor
reference_output_30 = CodeBlock(ref=createBaseCourseSurfaces_5.Surface) { ref; }

# group: Input Manager
value_for_import_from_others_36 = CodeBlock(MainInput=code_block_248, RefInput1=reference_output_30) { MainInput; RefInput1; RefInput2; }  # unwired: RefInput2

# group: <Func 8>Crushed Stone
code_block_295 = CodeBlock { "TargetElements"; }
valueAtKey_65 = DesignScript.Builtin.Dictionary.ValueAtKey(dictionary=value_for_import_from_others_36.MainInput, key=code_block_295)
createBaseCourseSurfaces_6 = Custom[CreateBaseCourseSurfaces](Element=valueAtKey_65)
# note: <Func>
code_block_296 = CodeBlock { 300; 100; }
boolean_3 = BoolSelector(false)
thicken_2 = Surface.Thicken(surface=createBaseCourseSurfaces_6.Surface, thickness=code_block_296.out0, both_sides=boolean_3)
volume_17 = Solid.Volume(solid=thicken_2)
code_block_297 = CodeBlock(i=volume_17) { Math.Round(List.Flatten(i)/1000000000, 2); }
code_block_298 = CodeBlock { "M3"; }
count_56 = List.Count(list=code_block_297)
ofRepeatedItem_46 = List.OfRepeatedItem(item=code_block_298, amount=count_56)
code_block_299 = CodeBlock(FuncValues=code_block_297, FuncValuesUnit=ofRepeatedItem_46)  # same code as code_block_20

# group: Output Manager
reference_output_31 = CodeBlock { ref; }  # unwired: ref
output_31 = CodeBlock(MainOutput=code_block_299) { MainOutput; RefOutput_geoColor; }  # unwired: RefOutput_geoColor

# group: Input Manager
value_for_import_from_others_37 = CodeBlock(MainInput=code_block_248) { MainInput; RefInput1; RefInput2; }  # unwired: RefInput1, RefInput2

# group: <Func 10>Rebar Work
code_block_300 = CodeBlock { "TargetElements"; }
valueAtKey_66 = DesignScript.Builtin.Dictionary.ValueAtKey(dictionary=value_for_import_from_others_37.MainInput, key=code_block_300)
code_block_301 = CodeBlock { "Volume"; }
# note: <Func>
getParameterValueByName_12 = Element.GetParameterValueByName(element=valueAtKey_66, parameterName=code_block_301)
sog_철근비_2 = DoubleInput(0)  # graph input
mul_5 = getParameterValueByName_12 * sog_철근비_2
code_block_302 = CodeBlock(i=mul_5) { Math.Round(List.Flatten(i)/1, 2); }
code_block_303 = CodeBlock { "TON"; }
count_57 = List.Count(list=code_block_302)
ofRepeatedItem_47 = List.OfRepeatedItem(item=code_block_303, amount=count_57)
code_block_304 = CodeBlock(FuncValues=code_block_302, FuncValuesUnit=ofRepeatedItem_47)  # same code as code_block_20

# group: Output Manager
reference_output_32 = CodeBlock { ref; }  # unwired: ref
output_32 = CodeBlock(MainOutput=code_block_304) { MainOutput; RefOutput_geoColor; }  # unwired: RefOutput_geoColor

join_5 = List.Join(list0=output_24.MainOutput, list1=output_26.MainOutput, list2=output_28.MainOutput, list3=output_29.MainOutput, list4=output_23.MainOutput, list5=output_27.MainOutput, list6=output_25.MainOutput, list7=output_30.MainOutput, list8=output_31.MainOutput, list9=output_22.MainOutput, list10=output_32.MainOutput)

# group: TargetWMunique + Data Sending
code_block_305 = CodeBlock(InputDic2=join_5) { _InputDic2; }
count_58 = List.Count(list=code_block_305)
code_block_306 = CodeBlock(InputDic1=selectTargetFamilyInformAsDictionary) { _InputDic1; }
code_block_307 = CodeBlock { "TargetWMunique"; }
valueAtKey_67 = DesignScript.Builtin.Dictionary.ValueAtKey(dictionary=code_block_306, key=code_block_307)
watch_33 = Watch(valueAtKey_67)
count_59 = List.Count(list=watch_33)
eq_5 = count_58 == count_59
organizeFuncValuesAndWorkMasterAsDiction_5 = Custom[OrganizeFuncValuesAndWorkMasterAsDictionary](InputDic1=code_block_306, InputDic2=code_block_305)
watch_34 = Watch()  # unwired: arg0
if_12 = If(test=eq_5, true=organizeFuncValuesAndWorkMasterAsDiction_5, false=watch_34)

# group: Select Target Family Element And Connected WorkMasters
code_block_308 = CodeBlock { 2; }
selectTargetFamilyInformAsDictionary_3 = Custom[SelectTargetFamilyInformAsDictionary](InputDic=organizeAllElementInformAsDictionary, InputIndex=code_block_308)

watch_35 = Watch(selectTargetFamilyInformAsDictionary_3)
watch_36 = Watch(byKeysValues_4)
code_block_309 = CodeBlock { i; }  # unwired: i

# group: Input Manager
value_for_import_from_others_38 = CodeBlock(MainInput=code_block_309) { MainInput; RefInput1; RefInput2; }  # unwired: RefInput1, RefInput2

# group: <Func 9>Lean Concrete
code_block_310 = CodeBlock { "TargetElements"; }
valueAtKey_68 = DesignScript.Builtin.Dictionary.ValueAtKey(dictionary=value_for_import_from_others_38.MainInput, key=code_block_310)
code_block_311 = CodeBlock { 0; 100; }
# note: <Func>
createLeanConcrete_9 = Custom[CreateLeanConcrete](Element=valueAtKey_68, leanOffset=code_block_311.out0, leanThick=code_block_311.out1)
volume_18 = Solid.Volume(solid=createLeanConcrete_9.Solid)
code_block_312 = CodeBlock(i=volume_18) { Math.Round(List.Flatten(i)/1000000000, 2); }
code_block_313 = CodeBlock { "M3"; }
count_60 = List.Count(list=code_block_312)
ofRepeatedItem_48 = List.OfRepeatedItem(item=code_block_313, amount=count_60)
code_block_314 = CodeBlock(FuncValues=code_block_312, FuncValuesUnit=ofRepeatedItem_48)  # same code as code_block_20

# group: Output Manager
reference_output_33 = CodeBlock(ref=createLeanConcrete_9.Solid) { ref; }
output_33 = CodeBlock(MainOutput=code_block_314, RefOutput_geoColor=createLeanConcrete_9.Solid) { MainOutput; RefOutput_geoColor; }

# group: Input Manager
value_for_import_from_others_39 = CodeBlock(MainInput=code_block_309, RefInput1=reference_output_33) { MainInput; RefInput1; RefInput2; }  # unwired: RefInput2

# group: <Func 4> Excavation (SOG 한정)
levels_5 = Levels("G.L")  # graph input
elevation_5 = Level.Elevation(level=levels_5)
code_block_315 = CodeBlock { "TargetElements"; }
valueAtKey_69 = DesignScript.Builtin.Dictionary.ValueAtKey(dictionary=value_for_import_from_others_39.MainInput, key=code_block_315)
code_block_316 = CodeBlock { "Elevation at Bottom"; }
getParameterValueByName_13 = Element.GetParameterValueByName(element=valueAtKey_69, parameterName=code_block_316)
린_콘크리트_하부까지의_길이_추출_최하단_5 = Python(IN[0]=value_for_import_from_others_39.RefInput1)  # CPython3; same code as 린_콘크리트_하부까지의_길이_추출_최하단
code_block_317 = CodeBlock(기초하단=getParameterValueByName_13, 린콘크리트하단=린_콘크리트_하부까지의_길이_추출_최하단_5) { 기초하단-린콘크리트하단; }
sub_5 = elevation_5 - code_block_317
code_block_318 = CodeBlock(i=sub_5) { i<0?true:false; }
code_block_319 = CodeBlock { 0; }
flatten_57 = List.Flatten(list=value_for_import_from_others_39.RefInput1)
하부_surface_추출_6 = Python(IN[0]=flatten_57)  # CPython3; same code as 하부_surface_추출
flatten_58 = List.Flatten(list=하부_surface_추출_6)
perimeterCurves_5 = Surface.PerimeterCurves(surface=flatten_58)
byJoinedCurves_5 = PolyCurve.ByJoinedCurves(curves=perimeterCurves_5)
code_block_320 = CodeBlock { _ExcavOffsetBottom: var[]..[] = 300; }
offset_9 = Curve.Offset(curve=byJoinedCurves_5, distance=code_block_320)
flatten_59 = List.Flatten(list=offset_9)
flatten_60 = List.Flatten(list=sub_5)
translate_5 = Geometry.Translate(geometry=offset_9, zTranslation=flatten_60)
경사_비율_입력_1_x_for_isofdn_4 = DoubleInput(2)  # graph input
code_block_321 = CodeBlock(ElevationatBottom=flatten_60, 비율=경사_비율_입력_1_x_for_isofdn_4) { ElevationatBottom/비율; }
offset_10 = Curve.Offset(curve=translate_5, distance=code_block_321)
flatten_61 = List.Flatten(list=offset_10)
list_create_9 = List.Create(item0=flatten_59, item1=flatten_61)
transpose_9 = List.Transpose(lists=list_create_9)
byLoft_5 = Solid.ByLoft(crossSections=transpose_9)
터파기_형상_겹침_해소_5 = Python(IN[0]=byLoft_5)  # CPython3; same code as 터파기_형상_겹침_해소
volume_19 = Solid.Volume(solid=터파기_형상_겹침_해소_5)
code_block_322 = CodeBlock(i=volume_19) { Math.Round(List.Flatten(i)/1000000000, 2); }
if_13 = If(test=code_block_318, true=code_block_319, false=code_block_322)
code_block_323 = CodeBlock { "M3"; }
count_61 = List.Count(list=code_block_322)
ofRepeatedItem_49 = List.OfRepeatedItem(item=code_block_323, amount=count_61)
code_block_324 = CodeBlock(FuncValues=if_13, FuncValuesUnit=ofRepeatedItem_49)  # same code as code_block_20
color_palette_8 = ColorPalette({R: 210, G: 105, B: 30, A: 135})
byGeometryColor_8 = Modifiers.GeometryColor.ByGeometryColor(geometry=터파기_형상_겹침_해소_5, color=color_palette_8)
forRefOutput_5 = CodeBlock(MainOutput=code_block_324, geoColor=byGeometryColor_8, 터파기형상=터파기_형상_겹침_해소_5)  # same code as forRefOutput

# group: Output Manager
output_34 = CodeBlock(MainOutput=forRefOutput_5, RefOutput_geoColor=byGeometryColor_8) { MainOutput; RefOutput_geoColor; }
reference_output_34 = CodeBlock(ref=터파기_형상_겹침_해소_5, ref2=if_13) { ref; ref2; }

# group: Visual Manager
visual_켜기_끄기_12 = BoolSelector(false)
visual_manager_12 = Python(IN[0]=output_34.RefOutput_geoColor, IN[1]=visual_켜기_끄기_12)  # CPython3; same code as visual_manager

watch_37 = Watch(output_34.MainOutput)

# group: Visual Manager
visual_켜기_끄기_13 = BoolSelector(false)
visual_manager_13 = Python(IN[0]=output_33.RefOutput_geoColor, IN[1]=visual_켜기_끄기_13)  # CPython3; same code as visual_manager

# group: Input Manager
value_for_import_from_others_40 = CodeBlock(MainInput=code_block_309) { MainInput; RefInput1; RefInput2; }  # unwired: RefInput1, RefInput2

# group: <Func 0> Hardner Finish (상부면)
code_block_325 = CodeBlock { "TargetElements"; }
# note: <Func>
valueAtKey_70 = DesignScript.Builtin.Dictionary.ValueAtKey(dictionary=value_for_import_from_others_40.MainInput, key=code_block_325)
flatten_62 = List.Flatten(list=valueAtKey_70)
# note: 일반화 여지가 있음
# (형상처리구간 + 물량계산 + 데이터 매칭)
extractUpperFacesOfElement_5 = Custom[ExtractUpperFacesOfElement](Element=flatten_62)
area_15 = Surface.Area(surface=extractUpperFacesOfElement_5.Surface)
sum_7 = Math.Sum(values=area_15)
code_block_326 = CodeBlock(i=sum_7) { Math.Round(List.Flatten(i)/1000000, 2); }
code_block_327 = CodeBlock { "M2"; }
count_62 = List.Count(list=code_block_326)
ofRepeatedItem_50 = List.OfRepeatedItem(item=code_block_327, amount=count_62)
code_block_328 = CodeBlock(FuncValues=code_block_326, FuncValuesUnit=ofRepeatedItem_50)  # same code as code_block_20
color_palette_9 = ColorPalette({R: 30, G: 144, B: 255, A: 129})
byGeometryColor_9 = Modifiers.GeometryColor.ByGeometryColor(geometry=extractUpperFacesOfElement_5.Surface, color=color_palette_9)

# group: Output Manager
output_35 = CodeBlock(MainOutput=code_block_328, RefOutput_geoColor=byGeometryColor_9) { MainOutput; RefOutput_geoColor; }
reference_output_35 = CodeBlock { ref; }  # unwired: ref

# group: Input Manager
value_for_import_from_others_41 = CodeBlock(MainInput=code_block_309) { MainInput; RefInput1; RefInput2; }  # unwired: RefInput1, RefInput2

# group: <Func 1> Structural Concrete
code_block_329 = CodeBlock { "TargetElements"; }
valueAtKey_71 = DesignScript.Builtin.Dictionary.ValueAtKey(dictionary=value_for_import_from_others_41.MainInput, key=code_block_329)
# note: <Func>
geometry_5 = Element.Geometry(element=valueAtKey_71)
volume_20 = Solid.Volume(solid=geometry_5)
code_block_330 = CodeBlock(i=volume_20) { Math.Round(List.Flatten(i)/1000000000,2); }
code_block_331 = CodeBlock { "M3"; }
count_63 = List.Count(list=code_block_330)
ofRepeatedItem_51 = List.OfRepeatedItem(item=code_block_331, amount=count_63)
code_block_332 = CodeBlock(FuncValues=code_block_330, FuncValuesUnit=ofRepeatedItem_51)  # same code as code_block_20

# group: Output Manager
output_36 = CodeBlock(MainOutput=code_block_332) { MainOutput; RefOutput_geoColor; }  # unwired: RefOutput_geoColor
reference_output_36 = CodeBlock(ref=geometry_5) { ref; }

# group: Input Manager
value_for_import_from_others_42 = CodeBlock(MainInput=code_block_309) { MainInput; RefInput1; RefInput2; }  # unwired: RefInput1, RefInput2

# group: <Func 2> Form Works (Ground Slab 거푸집 필요X)
code_block_333 = CodeBlock { "TargetElements"; }
valueAtKey_72 = DesignScript.Builtin.Dictionary.ValueAtKey(dictionary=value_for_import_from_others_42.MainInput, key=code_block_333)
code_block_334 = CodeBlock { "Volume"; }
# note: <Func>
getParameterValueByName_14 = Element.GetParameterValueByName(element=valueAtKey_72, parameterName=code_block_334)
code_block_335 = CodeBlock(i=getParameterValueByName_14) { Math.Round(List.Flatten(i)/10000000,2); }
code_block_336 = CodeBlock { "M3"; }
count_64 = List.Count(list=code_block_335)
ofRepeatedItem_52 = List.OfRepeatedItem(item=code_block_336, amount=count_64)
code_block_337 = CodeBlock(FuncValues=code_block_335, FuncValuesUnit=ofRepeatedItem_52)  # same code as code_block_20

# group: Output Manager
output_37 = CodeBlock(MainOutput=code_block_337) { MainOutput; RefOutput_geoColor; }  # unwired: RefOutput_geoColor
reference_output_37 = CodeBlock { ref; }  # unwired: ref

# group: Input Manager
value_for_import_from_others_43 = CodeBlock(MainInput=code_block_309) { MainInput; RefInput1; RefInput2; }  # unwired: RefInput1, RefInput2

# group: <Func 3> PE Sheet
code_block_338 = CodeBlock { "TargetElements"; }
valueAtKey_73 = DesignScript.Builtin.Dictionary.ValueAtKey(dictionary=value_for_import_from_others_43.MainInput, key=code_block_338)
# note: <Func>
createLeanConcrete_10 = Custom[CreateLeanConcrete](Element=valueAtKey_73)
area_16 = Surface.Area(surface=createLeanConcrete_10.Surface)
code_block_339 = CodeBlock(i=area_16) { Math.Round(List.Flatten(i)/1000000, 2); }
code_block_340 = CodeBlock { "M2"; }
count_65 = List.Count(list=code_block_339)
ofRepeatedItem_53 = List.OfRepeatedItem(item=code_block_340, amount=count_65)
code_block_341 = CodeBlock(FuncValues=code_block_339, FuncValuesUnit=ofRepeatedItem_53)  # same code as code_block_20

# group: Output Manager
output_38 = CodeBlock(MainOutput=code_block_341) { MainOutput; RefOutput_geoColor; }  # unwired: RefOutput_geoColor
reference_output_38 = CodeBlock { ref; }  # unwired: ref

# group: Input Manager
value_for_import_from_others_44 = CodeBlock(MainInput=code_block_309, RefInput1=reference_output_33, RefInput2=reference_output_34.ref, RefInput3=reference_output_36) { MainInput; RefInput1; RefInput2; RefInput3; }

# group: <Func 2> Backfill
value_for_import_from_others_45 = CodeBlock(터파기형상=value_for_import_from_others_44.RefInput2) { 터파기형상; }
flatten_63 = List.Flatten(list=value_for_import_from_others_45)
volume_21 = Solid.Volume(solid=flatten_63)
watch_38 = Watch(volume_21)
code_block_342 = CodeBlock(i=watch_38) { Math.Round(List.Flatten(i)/1000000000, 2); }
code_block_343 = CodeBlock { "M3"; }
count_66 = List.Count(list=watch_38)
ofRepeatedItem_54 = List.OfRepeatedItem(item=code_block_343, amount=count_66)
# note: 터파기 물량ㅈ에서 콘크리트, 린 기둥 물량 빼기
code_block_344 = CodeBlock(FuncValues=code_block_342, FuncValuesUnit=ofRepeatedItem_54)  # same code as code_block_20
value_for_import_from_others_46 = CodeBlock(슬라브형상=value_for_import_from_others_44.RefInput3) { 슬라브형상; }
flatten_64 = List.Flatten(list=value_for_import_from_others_46)
doesIntersect_5 = Geometry.DoesIntersect(geometry=flatten_63, other=flatten_64, lacing=CrossProduct)
filterByBoolMask_4 = List.FilterByBoolMask(list=flatten_64, mask=doesIntersect_5@L2)
flatten_65 = List.Flatten(list=filterByBoolMask_4.in)

# group: Output Manager
output_39 = CodeBlock(MainOutput=code_block_344) { MainOutput; RefOutput_geoColor; }  # unwired: RefOutput_geoColor
reference_output_39 = CodeBlock { ref; }  # unwired: ref

# group: Input Manager
value_for_import_from_others_47 = CodeBlock(MainInput=code_block_309, RefInput1=reference_output_34.ref2) { MainInput; RefInput1; RefInput2; }  # unwired: RefInput2

# group: <Func 6>Disposal
code_block_345 = CodeBlock(i=value_for_import_from_others_47.RefInput1) { i==0?true:false; }
code_block_346 = CodeBlock { 0; }
# note: <Func>
if_14 = If(test=code_block_345, true=code_block_346, false=value_for_import_from_others_47.RefInput1)
code_block_347 = CodeBlock(i=if_14) { Math.Round(List.Flatten(i)/1000000000, 2); }
code_block_348 = CodeBlock { "M3"; }
count_67 = List.Count(list=code_block_347)
ofRepeatedItem_55 = List.OfRepeatedItem(item=code_block_348, amount=count_67)
code_block_349 = CodeBlock(FuncValues=code_block_347, FuncValuesUnit=ofRepeatedItem_55)  # same code as code_block_20
code_block_350 = CodeBlock { "TargetElements"; }
valueAtKey_74 = DesignScript.Builtin.Dictionary.ValueAtKey(dictionary=value_for_import_from_others_47.MainInput, key=code_block_350)
count_68 = List.Count(list=valueAtKey_74@L1)

# group: Output Manager
output_40 = CodeBlock(MainOutput=code_block_349) { MainOutput; RefOutput_geoColor; }  # unwired: RefOutput_geoColor
reference_output_40 = CodeBlock { ref; }  # unwired: ref

# group: Input Manager
value_for_import_from_others_48 = CodeBlock(MainInput=code_block_309) { MainInput; RefInput1; RefInput2; }  # unwired: RefInput1, RefInput2

# group: <Func 7>Base Course
code_block_351 = CodeBlock { "TargetElements"; }
valueAtKey_75 = DesignScript.Builtin.Dictionary.ValueAtKey(dictionary=value_for_import_from_others_48.MainInput, key=code_block_351)
# note: <Func>
createBaseCourseSurfaces_7 = Custom[CreateBaseCourseSurfaces](Element=valueAtKey_75)
area_17 = Surface.Area(surface=createBaseCourseSurfaces_7.Surface)
code_block_352 = CodeBlock(i=area_17) { Math.Round(List.Flatten(i)/1000000, 2); }
code_block_353 = CodeBlock { "M2"; }
count_69 = List.Count(list=code_block_352)
ofRepeatedItem_56 = List.OfRepeatedItem(item=code_block_353, amount=count_69)
code_block_354 = CodeBlock(FuncValues=code_block_352, FuncValuesUnit=ofRepeatedItem_56)  # same code as code_block_20
code_block_355 = CodeBlock { 300; 100; }

# group: Output Manager
output_41 = CodeBlock(MainOutput=code_block_354) { MainOutput; RefOutput_geoColor; }  # unwired: RefOutput_geoColor
reference_output_41 = CodeBlock(ref=createBaseCourseSurfaces_7.Surface) { ref; }

# group: Input Manager
value_for_import_from_others_49 = CodeBlock(MainInput=code_block_309, RefInput1=reference_output_41) { MainInput; RefInput1; RefInput2; }  # unwired: RefInput2

# group: <Func 8>Crushed Stone
code_block_356 = CodeBlock { "TargetElements"; }
valueAtKey_76 = DesignScript.Builtin.Dictionary.ValueAtKey(dictionary=value_for_import_from_others_49.MainInput, key=code_block_356)
createBaseCourseSurfaces_8 = Custom[CreateBaseCourseSurfaces](Element=valueAtKey_76)
# note: <Func>
code_block_357 = CodeBlock { 300; 100; }
boolean_4 = BoolSelector(false)
thicken_3 = Surface.Thicken(surface=createBaseCourseSurfaces_8.Surface, thickness=code_block_357.out0, both_sides=boolean_4)
volume_22 = Solid.Volume(solid=thicken_3)
code_block_358 = CodeBlock(i=volume_22) { Math.Round(List.Flatten(i)/1000000000, 2); }
code_block_359 = CodeBlock { "M3"; }
count_70 = List.Count(list=code_block_358)
ofRepeatedItem_57 = List.OfRepeatedItem(item=code_block_359, amount=count_70)
code_block_360 = CodeBlock(FuncValues=code_block_358, FuncValuesUnit=ofRepeatedItem_57)  # same code as code_block_20

# group: Output Manager
output_42 = CodeBlock(MainOutput=code_block_360) { MainOutput; RefOutput_geoColor; }  # unwired: RefOutput_geoColor
reference_output_42 = CodeBlock { ref; }  # unwired: ref

# group: Input Manager
value_for_import_from_others_50 = CodeBlock(MainInput=code_block_309) { MainInput; RefInput1; RefInput2; }  # unwired: RefInput1, RefInput2

# group: <Func 10>Rebar Work
code_block_361 = CodeBlock { "TargetElements"; }
valueAtKey_77 = DesignScript.Builtin.Dictionary.ValueAtKey(dictionary=value_for_import_from_others_50.MainInput, key=code_block_361)
code_block_362 = CodeBlock { "Volume"; }
# note: <Func>
getParameterValueByName_15 = Element.GetParameterValueByName(element=valueAtKey_77, parameterName=code_block_362)
sog_철근비_3 = DoubleInput(0)  # graph input
mul_6 = getParameterValueByName_15 * sog_철근비_3
code_block_363 = CodeBlock(i=mul_6) { Math.Round(List.Flatten(i)/1, 2); }
code_block_364 = CodeBlock { "TON"; }
count_71 = List.Count(list=code_block_363)
ofRepeatedItem_58 = List.OfRepeatedItem(item=code_block_364, amount=count_71)
code_block_365 = CodeBlock(FuncValues=code_block_363, FuncValuesUnit=ofRepeatedItem_58)  # same code as code_block_20

# group: Output Manager
output_43 = CodeBlock(MainOutput=code_block_365) { MainOutput; RefOutput_geoColor; }  # unwired: RefOutput_geoColor
reference_output_43 = CodeBlock { ref; }  # unwired: ref

join_6 = List.Join(list0=output_35.MainOutput, list1=output_36.MainOutput, list2=output_37.MainOutput, list3=output_38.MainOutput, list4=output_34.MainOutput, list5=output_39.MainOutput, list6=output_40.MainOutput, list7=output_41.MainOutput, list8=output_42.MainOutput, list9=output_33.MainOutput, list10=output_43.MainOutput)

# group: TargetWMunique + Data Sending
code_block_366 = CodeBlock(InputDic2=join_6) { _InputDic2; }
count_72 = List.Count(list=code_block_366)
code_block_367 = CodeBlock { _InputDic1; }  # unwired: InputDic1
code_block_368 = CodeBlock { "TargetWMunique"; }
valueAtKey_78 = DesignScript.Builtin.Dictionary.ValueAtKey(dictionary=code_block_367, key=code_block_368)
watch_39 = Watch(valueAtKey_78)
count_73 = List.Count(list=watch_39)
eq_6 = count_72 == count_73
organizeFuncValuesAndWorkMasterAsDiction_6 = Custom[OrganizeFuncValuesAndWorkMasterAsDictionary](InputDic1=code_block_367, InputDic2=code_block_366)
watch_40 = Watch()  # unwired: arg0
if_15 = If(test=eq_6, true=organizeFuncValuesAndWorkMasterAsDiction_6, false=watch_40)

# group: <Func 6> Visual Manager
visual_켜기_끄기_14 = BoolSelector(false)
visual_manager_14 = Python(IN[0]=output_35.RefOutput_geoColor, IN[1]=visual_켜기_끄기_14)  # CPython3; same code as visual_manager

# group: WorkMaster 정리 후 재 작업
code_block_369 = CodeBlock {  }
code_block_370 = CodeBlock {  }

code_block_371 = CodeBlock(InputElement=all_elements_of_category) { _InputElement: var[]..[]; }

# group: GetUsedFamilyTypeOfModeling
code_block_372 = CodeBlock(InputElement=code_block_371) { _InputElement; }
name = Element.Name(element=code_block_372)
code_block_373 = CodeBlock { "_"; }
split = String.Split(str=name, separator0=code_block_373)
firstItem = List.FirstItem(list=split@L2)
uniqueItems_6 = List.UniqueItems(list=firstItem)
code_block_374 = CodeBlock(AllElement=code_block_372, UsedFamilyTypeOfMode=uniqueItems_6)
# ---------- code_block_374.designscript (4 lines) ----------
{
"AllElement": _AllElement,
"UsedFamilyTypeOfModeling": _UsedFamilyTypeOfModeling
};
# ----------------------------------------

code_block_375 = CodeBlock(InputFilePath=file_from_path) { _InputFilePath: var[]..[]; }
code_block_376 = CodeBlock(InputSheetName=code_block_6) { _InputSheetName: var[]..[]; }

# group: ImportExcel
code_block_377 = CodeBlock(InputDic=code_block_374) { _InputDic; }
code_block_378 = CodeBlock { "AllElement"; }
valueAtKey_79 = DesignScript.Builtin.Dictionary.ValueAtKey(dictionary=code_block_377, key=code_block_378)
code_block_379 = CodeBlock { "UsedFamilyTypeOfModeling"; }
valueAtKey_80 = DesignScript.Builtin.Dictionary.ValueAtKey(dictionary=code_block_377, key=code_block_379)
code_block_380 = CodeBlock(InputFilePath=code_block_375) { _InputFilePath; }
string_from_object = FromObject(object=code_block_380)
code_block_381 = CodeBlock(InputSheetName=code_block_376) { _InputSheetName; }
string_from_object_2 = FromObject(object=code_block_381)
python_script_import_excel_by = Python(IN[0]=string_from_object, IN[1]=string_from_object_2)  # "Python Script@Import Excel(By OpenpyXl)"; CPython3
# ---------- python_script_import_excel_by.python (50 lines) ----------
# Load the Python Standard and DesignScript Libraries
import sys
import os
#sys.path.append(r'C:\Users\HEC\AppData\Local\Programs\Python\Python39\Lib\site-packages')
#sys.path.append(r'C:\Users\pjmk0\AppData\Local\Programs\Python\Python39\Lib\site-packages')
sys.path.append(os.getenv('LOCALAPPDATA').replace('\\','\\\\') + r'\Programs\Python\Python39\Lib\site-packages')
import clr
clr.AddReference('ProtoGeometry')
from Autodesk.DesignScript.Geometry import *
from collections import Iterable

def iterable(obj):
    return isinstance(obj, Iterable)


# The inputs to this node will be stored as a list in the IN variables.
dataEnteringNode = IN
PathIn = IN[0]
SheetNameIn = IN[1]

# Place your code below this line
import datetime
import openpyxl

path = (PathIn)
#path = (r'C:\Users\pjmk0\Downloads\MK\mQ\BIM_물량집계 자동화 산출기준표_rC(20210607)_mk_de.xlsx')

wb_obj = openpyxl.load_workbook(path, data_only=True)
sheet_obj = wb_obj.get_sheet_by_name(SheetNameIn)

m_row = sheet_obj.max_row
m_col = sheet_obj.max_column

listOut = []



for i in range(1, m_row +1):
    listTemp = []
    for j in range(1, m_col + 1):
        cell_obj = sheet_obj.cell(row=i, column=j)
        listTemp.append(cell_obj.value)
        if len(listTemp) == m_col:
            listOut.append(listTemp)
        


# Assign your output to the OUT variable.
OUT = listOut
#OUT = os.getenv('APPDATA')
# ----------------------------------------
code_block_382 = CodeBlock(AllElement=valueAtKey_79, UsedFamilyTypeOfMode=valueAtKey_80, ExcelWholeDataSet=python_script_import_excel_by)
# ---------- code_block_382.designscript (5 lines) ----------
{
"AllElement": _AllElement,
"UsedFamilyTypeOfModeling": _UsedFamilyTypeOfModeling,
"ExcelWholeDataSet": _ExcelWholeDataSet
};
# ----------------------------------------

# group: GetExcelColumnDataSet
code_block_383 = CodeBlock(InputDic=code_block_382) { _InputDic; }
code_block_384 = CodeBlock { "AllElement"; }
valueAtKey_81 = DesignScript.Builtin.Dictionary.ValueAtKey(dictionary=code_block_383, key=code_block_384)
code_block_385 = CodeBlock { "ExcelWholeDataSet"; }
valueAtKey_82 = DesignScript.Builtin.Dictionary.ValueAtKey(dictionary=code_block_383, key=code_block_385)
transpose_10 = List.Transpose(lists=valueAtKey_82)
count_74 = List.Count(list=transpose_10)
code_block_386 = CodeBlock(i=count_74) { 0..i-1; }
string_from_object_3 = FromObject(object=code_block_386)
byKeysValues_5 = DesignScript.Builtin.Dictionary.ByKeysValues(keys=string_from_object_3, values=transpose_10)
code_block_387 = CodeBlock { "UsedFamilyTypeOfModeling"; }
valueAtKey_83 = DesignScript.Builtin.Dictionary.ValueAtKey(dictionary=code_block_383, key=code_block_387)
code_block_388 = CodeBlock(AllElement=valueAtKey_81, ExcelWholeDataSet=valueAtKey_82, ExcelColumnDataSet=byKeysValues_5, UsedFamilyTypeOfMode=valueAtKey_83)
# ---------- code_block_388.designscript (6 lines) ----------
{
"AllElement": _AllElement,
"ExcelWholeDataSet": _ExcelWholeDataSet,
"ExcelColumnDataSet": _ExcelColumnDataSet,
"UsedFamilyTypeOfModeling": _UsedFamilyTypeOfModeling
};
# ----------------------------------------

# group: GetExcelRowDataSet
code_block_389 = CodeBlock(InputDic=code_block_388) { _InputDic; }
code_block_390 = CodeBlock { "AllElement"; }
valueAtKey_84 = DesignScript.Builtin.Dictionary.ValueAtKey(dictionary=code_block_389, key=code_block_390)
code_block_391 = CodeBlock { "ExcelColumnDataSet"; }
valueAtKey_85 = DesignScript.Builtin.Dictionary.ValueAtKey(dictionary=code_block_389, key=code_block_391)
code_block_392 = CodeBlock { "ExcelWholeDataSet"; }
valueAtKey_86 = DesignScript.Builtin.Dictionary.ValueAtKey(dictionary=code_block_389, key=code_block_392)
count_75 = List.Count(list=valueAtKey_86)
code_block_393 = CodeBlock(i=count_75) { 0..i-1; }
string_from_object_4 = FromObject(object=code_block_393)
byKeysValues_6 = DesignScript.Builtin.Dictionary.ByKeysValues(keys=string_from_object_4, values=valueAtKey_86)
code_block_394 = CodeBlock { "UsedFamilyTypeOfModeling"; }
valueAtKey_87 = DesignScript.Builtin.Dictionary.ValueAtKey(dictionary=code_block_389, key=code_block_394)
code_block_395 = CodeBlock(AllElement=valueAtKey_84, ExcelColumnDataSet=valueAtKey_85, ExcelRowDataSet=byKeysValues_6, UsedFamilyTypeOfMode=valueAtKey_87)
# ---------- code_block_395.designscript (6 lines) ----------
{
"AllElement": _AllElement,
"ExcelColumnDataSet": _ExcelColumnDataSet,
"ExcelRowDataSet": _ExcelRowDataSet,
"UsedFamilyTypeOfModeling": _UsedFamilyTypeOfModeling
};
# ----------------------------------------

# group: GetColumnIndexOfUsedFamilyType
code_block_396 = CodeBlock(InputDic=code_block_395) { _InputDic; }
code_block_397 = CodeBlock { "AllElement"; }
valueAtKey_88 = DesignScript.Builtin.Dictionary.ValueAtKey(dictionary=code_block_396, key=code_block_397)
code_block_398 = CodeBlock { "ExcelRowDataSet"; }
valueAtKey_89 = DesignScript.Builtin.Dictionary.ValueAtKey(dictionary=code_block_396, key=code_block_398)
code_block_399 = CodeBlock { "ExcelColumnDataSet"; }
valueAtKey_90 = DesignScript.Builtin.Dictionary.ValueAtKey(dictionary=code_block_396, key=code_block_399)
code_block_400 = CodeBlock { 3; }
string_from_object_5 = FromObject(object=code_block_400)
valueAtKey_91 = DesignScript.Builtin.Dictionary.ValueAtKey(dictionary=valueAtKey_89, key=string_from_object_5)
string_from_object_6 = FromObject(object=valueAtKey_91)
code_block_401 = CodeBlock { "UsedFamilyTypeOfModeling"; }
valueAtKey_92 = DesignScript.Builtin.Dictionary.ValueAtKey(dictionary=code_block_396, key=code_block_401)
contains = String.Contains(searchFor=valueAtKey_92, lacing=CrossProduct)  # unwired: str
map_2 = List.Map(list=string_from_object_6, function=contains)
anyTrue = List.AnyTrue(list=map_2@L2)
code_block_402 = CodeBlock { true; }
allIndicesOf_2 = List.AllIndicesOf(list=anyTrue, item=code_block_402)
code_block_403 = CodeBlock(AllElement=valueAtKey_88, ExcelRowDataSet=valueAtKey_89, ExcelColumnDataSet=valueAtKey_90, ColumnIndexOfUsedFam=allIndicesOf_2, UsedFamilyTypeOfMode=valueAtKey_92)
# ---------- code_block_403.designscript (7 lines) ----------
{
"AllElement": _AllElement,
"ExcelRowDataSet": _ExcelRowDataSet,
"ExcelColumnDataSet": _ExcelColumnDataSet,
"ColumnIndexOfUsedFamilyType": _ColumnIndexOfUsedFamilyType,
"UsedFamilyTypeOfModeling": _UsedFamilyTypeOfModeling
};
# ----------------------------------------

# group: GetColumnDataSetOfUsedFamilyType
code_block_404 = CodeBlock(InputDic=code_block_403) { _InputDic; }
code_block_405 = CodeBlock { "AllElement"; }
valueAtKey_93 = DesignScript.Builtin.Dictionary.ValueAtKey(dictionary=code_block_404, key=code_block_405)
code_block_406 = CodeBlock { "ExcelRowDataSet"; }
valueAtKey_94 = DesignScript.Builtin.Dictionary.ValueAtKey(dictionary=code_block_404, key=code_block_406)
code_block_407 = CodeBlock { "ExcelColumnDataSet"; }
valueAtKey_95 = DesignScript.Builtin.Dictionary.ValueAtKey(dictionary=code_block_404, key=code_block_407)
code_block_408 = CodeBlock { "ColumnIndexOfUsedFamilyType"; }
valueAtKey_96 = DesignScript.Builtin.Dictionary.ValueAtKey(dictionary=code_block_404, key=code_block_408)
string_from_object_7 = FromObject(object=valueAtKey_96)
valueAtKey_97 = DesignScript.Builtin.Dictionary.ValueAtKey(dictionary=valueAtKey_95, key=string_from_object_7)
code_block_409 = CodeBlock { 4; ""; }
# note: 불필요 정보 처리
replaceItemAtIndex_7 = List.ReplaceItemAtIndex(list=valueAtKey_97@L2, index=code_block_409.out0, item=code_block_409.out1)
code_block_410 = CodeBlock { "UsedFamilyTypeOfModeling"; }
valueAtKey_98 = DesignScript.Builtin.Dictionary.ValueAtKey(dictionary=code_block_404, key=code_block_410)
code_block_411 = CodeBlock(AllElement=valueAtKey_93, ExcelRowDataSet=valueAtKey_94, ExcelColumnDataSet=valueAtKey_95, ColumnIndexOfUsedFam=valueAtKey_96, ColumnDataSetOfUsedF=replaceItemAtIndex_7, UsedFamilyTypeOfMode=valueAtKey_98)
# ---------- code_block_411.designscript (8 lines) ----------
{
"AllElement": _AllElement,
"ExcelRowDataSet": _ExcelRowDataSet,
"ExcelColumnDataSet": _ExcelColumnDataSet,
"ColumnIndexOfUsedFamilyType": _ColumnIndexOfUsedFamilyType,
"ColumnDataSetOfUsedFamilyType": _ColumnDataSetOfUsedFamilyType,
"UsedFamilyTypeOfModeling": _UsedFamilyTypeOfModeling
};
# ----------------------------------------

# group: GetRowDataSetOfUsedWorkMaster
code_block_412 = CodeBlock(InputDic=code_block_411) { _InputDic; }
code_block_413 = CodeBlock { "AllElement"; }
valueAtKey_99 = DesignScript.Builtin.Dictionary.ValueAtKey(dictionary=code_block_412, key=code_block_413)
code_block_414 = CodeBlock { "ExcelRowDataSet"; }
valueAtKey_100 = DesignScript.Builtin.Dictionary.ValueAtKey(dictionary=code_block_412, key=code_block_414)
code_block_415 = CodeBlock { "ColumnDataSetOfUsedFamilyType"; }
valueAtKey_101 = DesignScript.Builtin.Dictionary.ValueAtKey(dictionary=code_block_412, key=code_block_415)
string_from_object_8 = FromObject(object=valueAtKey_101)
code_block_416 = CodeBlock { "000"; }
contains_2 = String.Contains(str=string_from_object_8@L2, searchFor=code_block_416, lacing=CrossProduct)
code_block_417 = CodeBlock { true; }
allIndicesOf_3 = List.AllIndicesOf(list=contains_2@L2, item=code_block_417)
string_from_object_9 = FromObject(object=allIndicesOf_3)
valueAtKey_102 = DesignScript.Builtin.Dictionary.ValueAtKey(dictionary=valueAtKey_100, key=string_from_object_9)
code_block_418 = CodeBlock { "UsedFamilyTypeOfModeling"; }
valueAtKey_103 = DesignScript.Builtin.Dictionary.ValueAtKey(dictionary=code_block_412, key=code_block_418)
code_block_419 = CodeBlock(AllElement=valueAtKey_99, RowDataSetOfUsedWork=valueAtKey_102, ColumnDataSetOfUsedF=valueAtKey_101, TargetWMRowIndex=allIndicesOf_3, UsedFamilyTypeOfMode=valueAtKey_103)
# ---------- code_block_419.designscript (7 lines) ----------
{
"AllElement": _AllElement,
"RowDataSetOfUsedWorkMaster": _RowDataSetOfUsedWorkMaster,
"ColumnDataSetOfUsedFamilyType": _ColumnDataSetOfUsedFamilyType,
"TargetWMRowIndex": _TargetWMRowIndex,
"UsedFamilyTypeOfModeling": _UsedFamilyTypeOfModeling
};
# ----------------------------------------

# group: GetMatchedWorkMasterAndDescription
code_block_420 = CodeBlock(InputDic=code_block_419) { _InputDic; }
code_block_421 = CodeBlock { "AllElement"; }
valueAtKey_104 = DesignScript.Builtin.Dictionary.ValueAtKey(dictionary=code_block_420, key=code_block_421)
code_block_422 = CodeBlock { "RowDataSetOfUsedWorkMaster"; }
valueAtKey_105 = DesignScript.Builtin.Dictionary.ValueAtKey(dictionary=code_block_420, key=code_block_422)
code_block_423 = CodeBlock { "ColumnDataSetOfUsedFamilyType"; }
valueAtKey_106 = DesignScript.Builtin.Dictionary.ValueAtKey(dictionary=code_block_420, key=code_block_423)
code_block_424 = CodeBlock { "TargetWMRowIndex"; }
valueAtKey_107 = DesignScript.Builtin.Dictionary.ValueAtKey(dictionary=code_block_420, key=code_block_424)
code_block_425 = CodeBlock { "UsedFamilyTypeOfModeling"; }
valueAtKey_108 = DesignScript.Builtin.Dictionary.ValueAtKey(dictionary=code_block_420, key=code_block_425)
code_block_426 = CodeBlock { 0; }
getItemAtIndex_3 = List.GetItemAtIndex(list=valueAtKey_105@@L2, index=code_block_426)
getItemAtIndex_4 = List.GetItemAtIndex(list=valueAtKey_106@@L2, index=valueAtKey_107@L2)
code_block_427 = CodeBlock(i=getItemAtIndex_3, j=getItemAtIndex_4) { i +"-"+ j; }
code_block_428 = CodeBlock { 1; }
getItemAtIndex_5 = List.GetItemAtIndex(list=valueAtKey_105@@L2, index=code_block_428)
code_block_429 = CodeBlock { 2; }
getItemAtIndex_6 = List.GetItemAtIndex(list=valueAtKey_105@@L2, index=code_block_429)
code_block_430 = CodeBlock { 3; }
getItemAtIndex_7 = List.GetItemAtIndex(list=valueAtKey_105@@L2, index=code_block_430)
code_block_431 = CodeBlock { 4; }
getItemAtIndex_8 = List.GetItemAtIndex(list=valueAtKey_105@@L2, index=code_block_431)
code_block_432 = CodeBlock(a=getItemAtIndex_5, b=getItemAtIndex_6, c=getItemAtIndex_7, d=getItemAtIndex_8) { a +" "+ b +" "+ c +" "+"("+ d +")"; }
code_block_433 = CodeBlock(AllElement=valueAtKey_104, RowDataSetOfUsedWork=valueAtKey_105, ColumnDataSetOfUsedF=valueAtKey_106, TargetWMRowIndex=valueAtKey_107, UsedFamilyTypeOfMode=valueAtKey_108, MatchedWorkGruopAndM=code_block_427, MatchedWMDescription=code_block_432, MatchedWMUnit=getItemAtIndex_8)
# ---------- code_block_433.designscript (10 lines) ----------
{
"AllElement": _AllElement,
"RowDataSetOfUsedWorkMaster": _RowDataSetOfUsedWorkMaster,
"ColumnDataSetOfUsedFamilyType": _ColumnDataSetOfUsedFamilyType,
"TargetWMRowIndex": _TargetWMRowIndex,
"UsedFamilyTypeOfModeling": _UsedFamilyTypeOfModeling,
"MatchedWorkGruopAndMasterCode": _MatchedWorkGruopAndMasterCode,
"MatchedWMDescription": _MatchedWMDescription,
"MatchedWMUnit": _MatchedWMUnit
};
# ----------------------------------------

# group: GetWorkMasterCodePerFamilyTypeAndWMDescriptionDictionary
code_block_434 = CodeBlock(InputDic=code_block_433) { _InputDic; }
code_block_435 = CodeBlock { "AllElement"; }
valueAtKey_109 = DesignScript.Builtin.Dictionary.ValueAtKey(dictionary=code_block_434, key=code_block_435)
code_block_436 = CodeBlock { "ColumnDataSetOfUsedFamilyType"; }
valueAtKey_110 = DesignScript.Builtin.Dictionary.ValueAtKey(dictionary=code_block_434, key=code_block_436)
code_block_437 = CodeBlock { 3; }
# note: UsedFamilyTypeInExcelOrder
getItemAtIndex_9 = List.GetItemAtIndex(list=valueAtKey_110@L2, index=code_block_437)
code_block_438 = CodeBlock { "_"; }
split_2 = String.Split(str=getItemAtIndex_9, separator0=code_block_438)
firstItem_2 = List.FirstItem(list=split_2@L2)
code_block_439 = CodeBlock(InputDic=code_block_434) { _InputDic; }
code_block_440 = CodeBlock { "MatchedWorkGruopAndMasterCode"; }
valueAtKey_111 = DesignScript.Builtin.Dictionary.ValueAtKey(dictionary=code_block_439, key=code_block_440)
byKeysValues_7 = DesignScript.Builtin.Dictionary.ByKeysValues(keys=firstItem_2, values=valueAtKey_111)
flatten_66 = List.Flatten(list=valueAtKey_111)
code_block_441 = CodeBlock { "MatchedWMDescription"; }
valueAtKey_112 = DesignScript.Builtin.Dictionary.ValueAtKey(dictionary=code_block_434, key=code_block_441)
flatten_67 = List.Flatten(list=valueAtKey_112)
# note: WM - description dictionary
byKeysValues_8 = DesignScript.Builtin.Dictionary.ByKeysValues(keys=flatten_66, values=flatten_67)
code_block_442 = CodeBlock(AllElement=valueAtKey_109, WorkMasterCodePerFam=byKeysValues_7, WMAndDescriptionDict=byKeysValues_8)
# ---------- code_block_442.designscript (9 lines) ----------
{
"AllElement": _AllElement,
//"RowDataSetOfUsedWorkMaster": _RowDataSetOfUsedWorkMaster,
//"ColumnDataSetOfUsedFamilyType": _ColumnDataSetOfUsedFamilyType,
//"TargetWMRowIndex": _TargetWMRowIndex,
//"UsedFamilyTypeOfModeling": _UsedFamilyTypeOfModeling,
"WorkMasterCodePerFamilyType": _WorkMasterCodePerFamilyType,
"WMAndDescriptionDictionary": _WMAndDescriptionDictionary
};
# ----------------------------------------

# group: GetWorkMasterCodePerElement
code_block_443 = CodeBlock(InputDic=code_block_442) { _InputDic; }
code_block_444 = CodeBlock { "AllElement"; }
valueAtKey_113 = DesignScript.Builtin.Dictionary.ValueAtKey(dictionary=code_block_443, key=code_block_444)
code_block_445 = CodeBlock { "WorkMasterCodePerFamilyType"; }
valueAtKey_114 = DesignScript.Builtin.Dictionary.ValueAtKey(dictionary=code_block_443, key=code_block_445)
keys_3 = DesignScript.Builtin.Dictionary.Keys(dictionary=valueAtKey_114)
name_2 = Element.Name(element=valueAtKey_113)
contains_3 = String.Contains(str=name_2@L1, searchFor=keys_3)
code_block_446 = CodeBlock { true; }
allIndicesOf_4 = List.AllIndicesOf(list=contains_3@L2, item=code_block_446)
flatten_68 = List.Flatten(list=allIndicesOf_4)
getItemAtIndex_10 = List.GetItemAtIndex(list=keys_3, index=flatten_68)
valueAtKey_115 = DesignScript.Builtin.Dictionary.ValueAtKey(dictionary=valueAtKey_114, key=getItemAtIndex_10)
getMaterials = Element.GetMaterials(element=valueAtKey_113)
code_block_447 = CodeBlock { "WMAndDescriptionDictionary"; }
valueAtKey_116 = DesignScript.Builtin.Dictionary.ValueAtKey(dictionary=code_block_443, key=code_block_447)
code_block_448 = CodeBlock(AllElement=valueAtKey_113, WorkMasterCodePerFam=valueAtKey_114, WorkMasterCodePerEle=valueAtKey_115, MaterialPerElementFr=getMaterials, WMAndDescriptionDict=valueAtKey_116)
# ---------- code_block_448.designscript (11 lines) ----------
{
"AllElement": _AllElement,
//"RowDataSetOfUsedWorkMaster": _RowDataSetOfUsedWorkMaster,
//"ColumnDataSetOfUsedFamilyType": _ColumnDataSetOfUsedFamilyType,
//"TargetWMRowIndex": _TargetWMRowIndex,
//"UsedFamilyTypeOfModeling": _UsedFamilyTypeOfModeling,
"WorkMasterCodePerFamilyType": _WorkMasterCodePerFamilyType,
"WorkMasterCodePerElement": _WorkMasterCodePerElement,
"MaterialPerElementFromModeling": _MaterialPerElementFromModeling,
"WMAndDescriptionDictionary": _WMAndDescriptionDictionary
};
# ----------------------------------------

# group: GetWorkMasterCodePerElementAndWMDictionaryFromModeling
code_block_449 = CodeBlock(InputDic=code_block_448) { _InputDic; }
code_block_450 = CodeBlock { "AllElement"; }
valueAtKey_117 = DesignScript.Builtin.Dictionary.ValueAtKey(dictionary=code_block_449, key=code_block_450)
code_block_451 = CodeBlock { "WorkMasterCodePerFamilyType"; }
valueAtKey_118 = DesignScript.Builtin.Dictionary.ValueAtKey(dictionary=code_block_449, key=code_block_451)
code_block_452 = CodeBlock { "WorkMasterCodePerElement"; }
valueAtKey_119 = DesignScript.Builtin.Dictionary.ValueAtKey(dictionary=code_block_449, key=code_block_452)
code_block_453 = CodeBlock { "MaterialPerElementFromModeling"; }
valueAtKey_120 = DesignScript.Builtin.Dictionary.ValueAtKey(dictionary=code_block_449, key=code_block_453)
name_3 = Element.Name(element=valueAtKey_120)
code_block_454 = CodeBlock { "_"; }
split_3 = String.Split(str=name_3, separator0=code_block_454)
firstItem_3 = List.FirstItem(list=split_3@@L2)
code_block_455 = CodeBlock { "WMAndDescriptionDictionary"; }
valueAtKey_121 = DesignScript.Builtin.Dictionary.ValueAtKey(dictionary=code_block_449, key=code_block_455)
flatten_69 = List.Flatten(list=firstItem_3)
code_block_456 = CodeBlock { " "; }
restOfItems = List.RestOfItems(list=split_3@@L2)
join_7 = String.Join(separator=code_block_456, string0=restOfItems@@L2)
flatten_70 = List.Flatten(list=join_7)
byKeysValues_9 = DesignScript.Builtin.Dictionary.ByKeysValues(keys=flatten_69, values=flatten_70)
code_block_457 = CodeBlock(AllElement=valueAtKey_117, WorkMasterCodePerFam=valueAtKey_118, WorkMasterCodePerEle=valueAtKey_119, MaterialPerElementFr=firstItem_3, WMAndDescriptionDict=valueAtKey_121, MaterialsDescription=byKeysValues_9)
# ---------- code_block_457.designscript (8 lines) ----------
{
"AllElement": _AllElement,
"WorkMasterCodePerFamilyType": _WorkMasterCodePerFamilyType,
"WorkMasterCodePerElement": _WorkMasterCodePerElement,
"MaterialPerElementFromModeling": _MaterialPerElementFromModeling,
"WMAndDescriptionDictionary": _WMAndDescriptionDictionary,
"MaterialsDescriptionDictionary": _MaterialsDescriptionDictionary
};
# ----------------------------------------

# group: GetWorkMasterCodePerElementFromBoth(Excel&Modeling)
code_block_458 = CodeBlock(InputDic=code_block_457) { _InputDic; }
code_block_459 = CodeBlock { "AllElement"; }
valueAtKey_122 = DesignScript.Builtin.Dictionary.ValueAtKey(dictionary=code_block_458, key=code_block_459)
code_block_460 = CodeBlock { "WorkMasterCodePerFamilyType"; }
valueAtKey_123 = DesignScript.Builtin.Dictionary.ValueAtKey(dictionary=code_block_458, key=code_block_460)
code_block_461 = CodeBlock { "MaterialPerElementFromModeling"; }
valueAtKey_124 = DesignScript.Builtin.Dictionary.ValueAtKey(dictionary=code_block_458, key=code_block_461)
code_block_462 = CodeBlock { "WorkMasterCodePerElement"; }
valueAtKey_125 = DesignScript.Builtin.Dictionary.ValueAtKey(dictionary=code_block_458, key=code_block_462)
addItemToFront_2 = List.AddItemToFront(item=valueAtKey_124@L2, list=valueAtKey_125@@L2)
code_block_463 = CodeBlock { 1; }
flatten_71 = List.Flatten(list=addItemToFront_2@L3, amt=code_block_463)
uniqueItems_7 = List.UniqueItems(list=flatten_71@L2)
code_block_464 = CodeBlock(AllElement=valueAtKey_122, WorkMasterCodePerFam=valueAtKey_123, WorkMasterCodePerEle=uniqueItems_7)
# ---------- code_block_464.designscript (6 lines) ----------
{
"AllElement": _AllElement,
"WorkMasterCodePerFamilyType": _WorkMasterCodePerFamilyType,
"WorkMasterCodePerElementBoth": _WorkMasterCodePerElementBoth
//"WMAndDescriptionDictionaryBoth": _WMAndDescriptionDictionaryBoth
};
# ----------------------------------------

# group: GetWMAndDescriptionDictionaryFromBoth(Excel&Modeling)
code_block_465 = CodeBlock(InputDic=code_block_457) { _InputDic; }
code_block_466 = CodeBlock { "AllElement"; }
valueAtKey_126 = DesignScript.Builtin.Dictionary.ValueAtKey(dictionary=code_block_465, key=code_block_466)
code_block_467 = CodeBlock { "WorkMasterCodePerFamilyType"; }
valueAtKey_127 = DesignScript.Builtin.Dictionary.ValueAtKey(dictionary=code_block_465, key=code_block_467)
code_block_468 = CodeBlock { "MaterialsDescriptionDictionary"; }
valueAtKey_128 = DesignScript.Builtin.Dictionary.ValueAtKey(dictionary=code_block_465, key=code_block_468)
components_2 = DesignScript.Builtin.Dictionary.Components(dictionary=valueAtKey_128)
code_block_469 = CodeBlock { "WMAndDescriptionDictionary"; }
valueAtKey_129 = DesignScript.Builtin.Dictionary.ValueAtKey(dictionary=code_block_465, key=code_block_469)
components_3 = DesignScript.Builtin.Dictionary.Components(dictionary=valueAtKey_129)
contains_4 = String.Contains(str=components_3.keys@@L1, searchFor=components_2.keys)
anyTrue_2 = List.AnyTrue(list=contains_4@L2)
code_block_470 = CodeBlock { true; }
allIndicesOf_5 = List.AllIndicesOf(list=anyTrue_2, item=code_block_470)
removeItemAtIndex = List.RemoveItemAtIndex(list=components_3.keys, indices=allIndicesOf_5)
addItemToEnd_3 = List.AddItemToEnd(item=components_2.keys, list=removeItemAtIndex)
flatten_72 = List.Flatten(list=addItemToEnd_3)
removeItemAtIndex_2 = List.RemoveItemAtIndex(list=components_3.values, indices=allIndicesOf_5)
addItemToEnd_4 = List.AddItemToEnd(item=components_2.values, list=removeItemAtIndex_2)
flatten_73 = List.Flatten(list=addItemToEnd_4)
byKeysValues_10 = DesignScript.Builtin.Dictionary.ByKeysValues(keys=flatten_72, values=flatten_73)
code_block_471 = CodeBlock(AllElement=valueAtKey_126, WorkMasterCodePerFam=valueAtKey_127, WMAndDescriptionDict=byKeysValues_10)
# ---------- code_block_471.designscript (5 lines) ----------
{
"AllElement": _AllElement,
"WorkMasterCodePerFamilyType": _WorkMasterCodePerFamilyType,
"WMAndDescriptionDictionaryBoth": _WMAndDescriptionDictionaryBoth
};
# ----------------------------------------

# group: GetFullWMCodeDescriptionPerElement
code_block_472 = CodeBlock(InputDic1=code_block_464) { _InputDic1; }
code_block_473 = CodeBlock { "AllElement"; }
valueAtKey_130 = DesignScript.Builtin.Dictionary.ValueAtKey(dictionary=code_block_472, key=code_block_473)
code_block_474 = CodeBlock { "WorkMasterCodePerFamilyType"; }
valueAtKey_131 = DesignScript.Builtin.Dictionary.ValueAtKey(dictionary=code_block_472, key=code_block_474)
code_block_475 = CodeBlock { "WorkMasterCodePerElementBoth"; }
valueAtKey_132 = DesignScript.Builtin.Dictionary.ValueAtKey(dictionary=code_block_472, key=code_block_475)
code_block_476 = CodeBlock(InputDic2=code_block_471) { _InputDic2; }
code_block_477 = CodeBlock { "WMAndDescriptionDictionaryBoth"; }
valueAtKey_133 = DesignScript.Builtin.Dictionary.ValueAtKey(dictionary=code_block_476, key=code_block_477)
valueAtKey_134 = DesignScript.Builtin.Dictionary.ValueAtKey(dictionary=valueAtKey_133, key=valueAtKey_132)
code_block_478 = CodeBlock(a=valueAtKey_132, b=valueAtKey_134) { a +": "+ b; }
code_block_479 = CodeBlock(AllElement=valueAtKey_130, WorkMasterCodePerFam=valueAtKey_131, WorkMasterCodePerEle=valueAtKey_132, FullWMCodeDescriptio=code_block_478)
# ---------- code_block_479.designscript (6 lines) ----------
{
"AllElement": _AllElement,
"WorkMasterCodePerFamilyType": _WorkMasterCodePerFamilyType,
"WorkMasterCodePerElementBoth": _WorkMasterCodePerElementBoth,
"FullWMCodeDescriptionPerElement": _FullWMCodeDescriptionPerElement
};
# ----------------------------------------
code_block_480 = CodeBlock { "FullWMCodeDescriptionPerElement"; }
valueAtKey_135 = DesignScript.Builtin.Dictionary.ValueAtKey(dictionary=code_block_479, key=code_block_480)
code_block_481 = CodeBlock(FullWMCodeDescriptio=valueAtKey_135) { _FullWMCodeDescriptionPerElement; }
code_block_482 = CodeBlock { Dictionary; }

code_block_483 = CodeBlock(InputElement=all_elements_of_category) { _InputElement: var[]..[]; }
code_block_484 = CodeBlock(InputFilePath=file_from_path) { _InputFilePath: var[]..[]; }
code_block_485 = CodeBlock(InputSheetName=code_block_6) { _InputSheetName: var[]..[]; }
code_block_486 = CodeBlock(InputElement=code_block_483, InputFilePath=code_block_484, InputSheetName=code_block_485) { _InputElement; _InputFilePath; _InputSheetName; }
excelDataManagerNode = Python(IN[0]=code_block_486._InputElement, IN[1]=code_block_486._InputFilePath, IN[2]=code_block_486._InputSheetName)  # CPython3
# ---------- excelDataManagerNode.python (279 lines) ----------
# Load the Python Standard and DesignScript Libraries
import os
import sys
sys.path.append(os.getenv('LOCALAPPDATA').replace('\\','\\\\') + r'\Programs\Python\Python39\Lib\site-packages')
import clr
clr.AddReference('RevitAPI')
import Autodesk

clr.AddReference('ProtoGeometry')
from Autodesk.DesignScript.Geometry import *

clr.AddReference('RevitNodes')
import Revit
clr.ImportExtensions(Revit.Elements)

clr.ImportExtensions(Revit.GeometryConversion)
clr.ImportExtensions(Revit.GeometryReferences)

clr.AddReference('RevitServices')
import RevitServices
from RevitServices.Persistence import DocumentManager
from RevitServices.Transactions import TransactionManager

doc = DocumentManager.Instance.CurrentDBDocument

import random
import itertools
from functools import reduce
from collections import Iterable
import datetime
import openpyxl

def iterable(obj):
    return isinstance(obj, Iterable)

def findUnique(inputs):
    result = []
    for i in inputs:
        if i in result:
            pass
        else:
            result.append(i)
    return result

# The inputs to this node will be stored as a list in the IN variables.
dataEnteringNode = IN
inputElements = IN[0]
inputFilePath = IN[1]
inputSheetName = IN[2]

def importExcel(path, SheetNameIn):
    wb_obj = openpyxl.load_workbook(str(path), data_only=True)
    sheet_obj = wb_obj.get_sheet_by_name(str(SheetNameIn))

    m_row = sheet_obj.max_row
    m_col = sheet_obj.max_column

    listOut = []

    for i in range(1, m_row +1):
        listTemp = []
        for j in range(1, m_col + 1):
            cell_obj = sheet_obj.cell(row=i, column=j)
            listTemp.append(cell_obj.value)
            if len(listTemp) == m_col:
                listOut.append(listTemp)
    return listOut

def getUsedFamilyTypeOfModeling(elements):
    familyCode = list(map(lambda x: x.Name.split('_')[0], elements))
    unq_familyCode = findUnique(familyCode)
    return unq_familyCode
    
def createExcelDataDictionary(values):
    result = {}
    for i in range(len(values)):
        result[str(i)] = values[i]
    return result

def findTargetIndex(targets, list):
    result = []
    for target in targets:
        for i in range(len(list)):
            if target in str(list[i]):
                result.append(i)
            else:
                pass
    result.sort()
    return result
    
def GetValueAtKeys(keys, dictionary):
    result = [] 
    for i in keys:
        result.append(dictionary[str(i)])
    return result


# Place your code below this line
usedFamilyTypeOfModeling = getUsedFamilyTypeOfModeling(inputElements)
excelWholeDataSet = importExcel(inputFilePath, inputSheetName)
trExcelWholeDataSet = list(zip(*excelWholeDataSet))
excelColumnDataSet = createExcelDataDictionary(trExcelWholeDataSet)
excelRowDataSet = createExcelDataDictionary(excelWholeDataSet)
ColumnIndexOfUsedFamilyType = findTargetIndex(usedFamilyTypeOfModeling, trExcelWholeDataSet)
ColDataSetOfUsedFamilyType = GetValueAtKeys(ColumnIndexOfUsedFamilyType, excelColumnDataSet)
materialPerElementFromModeling = []
for i in inputElements:
    materialPerElementFromModeling.append(i.GetMaterials())
#list(map(lambda x: x.GetMaterials, inputElements)) "맵함수로 처리하면 리스트화 할 때 타입 변환 오류 남"

targetWMRowIndex = []
for i in ColDataSetOfUsedFamilyType:
    targetWMRowIndex.append(findTargetIndex(['000'], i))

rowDataSetOfUsedWM = []
for i in targetWMRowIndex:
    rowDataSetOfUsedWM.append(GetValueAtKeys(i, excelRowDataSet))

workGroup = []
for i in rowDataSetOfUsedWM:
    tmp = []
    for j in i:
        tmp.append(j[0])
    workGroup.append(tmp)
    
workMaster = []
for i in range(len(ColDataSetOfUsedFamilyType)):
    tmp=[]
    for k in targetWMRowIndex[i]:
        tmp.append(ColDataSetOfUsedFamilyType[i][k])
    workMaster.append(tmp)

matchedWM = []
for i in range(len(workGroup)):
    tmp = []
    for j in range(len(workGroup[i])):
        fullWM = workGroup[i][j] +"-"+ workMaster[i][j]
        tmp.append(fullWM)
    matchedWM.append(tmp)

matchedWorkGruopAndMasterCode = []
for i in matchedWM:
    if len(i) > 0:
        matchedWorkGruopAndMasterCode.append(i)
    else:
        pass

matchedWMDescription = []
for i in rowDataSetOfUsedWM:
    tmp=[]
    for j in i:
        tmp.append(j[1] +" "+ j[2] +" "+ j[3] +" "+ "("+ j[4] +")")
    if len(tmp) > 0:
        matchedWMDescription.append(tmp)
    else:
        pass

matchedWMUnit = []
for i in rowDataSetOfUsedWM:
    tmp=[]
    for j in i:
        tmp.append(j[4])
    if len(tmp) > 0:
        matchedWMUnit.append(tmp)
    else:
        pass

matchedWorkGruopAndMasterCode_flat = list(itertools.chain(*matchedWorkGruopAndMasterCode))
matchedWMDescription_flat = list(itertools.chain(*matchedWMDescription))

dic_WMandDescription_Excel = {}
for i in range(len(matchedWorkGruopAndMasterCode_flat)):
    dic_WMandDescription_Excel[matchedWorkGruopAndMasterCode_flat[i]] = matchedWMDescription_flat[i]

usedFamilyTypeInExcelOrder = list(map(lambda x: x[3], ColDataSetOfUsedFamilyType))
usedFamilyCodeInExcelOrder = findUnique(list(map(lambda x: x.split('_')[0], usedFamilyTypeInExcelOrder)))

dic_FamilyCodeandWM = {}
for i in range(len(usedFamilyCodeInExcelOrder)):
    dic_FamilyCodeandWM[usedFamilyCodeInExcelOrder[i]] = matchedWorkGruopAndMasterCode[i]

workMasterCodePerElement = []
familyCodePerElem = list(map(lambda x: x.Name.split('_')[0], inputElements))
for i in familyCodePerElem:
    workMasterCodePerElement.append(dic_FamilyCodeandWM[i])

materialNamePerElem = []
for i in materialPerElementFromModeling:
    tmp = []
    for j in i:
        tmp.append(j.Name)
    materialNamePerElem.append(tmp)

WMPerElementFromModeling = []
for i in materialNamePerElem:
    tmp = []
    for j in i:
        tmp.append(j.split('_')[0])
    WMPerElementFromModeling.append(tmp)

specPerElementFromModeling = []
for i in materialNamePerElem:
    tmp = []
    for j in i:
        a = j.split('_')
        del a[0]
        b = " ".join(a)
        tmp.append(b)
    specPerElementFromModeling.append(tmp)

WMPerElementFromModeling_flat = list(itertools.chain(*WMPerElementFromModeling))
specPerElementFromModeling_flat = list(itertools.chain(*specPerElementFromModeling))

dic_WMandDescription_Model = {}
for i in range(len(WMPerElementFromModeling_flat)):
    dic_WMandDescription_Model[WMPerElementFromModeling_flat[i]] = specPerElementFromModeling_flat[i]

def findAllKeys(dict):
    result = []
    for key in dict.keys():
        result.append(key)
    return result

def findAllValues(dict):
    result = []
    for key in dict.keys():
        result.append(dict[key])
    return result

keys_WMandDescription_Model = findAllKeys(dic_WMandDescription_Model)
keys_WMandDescription_Excel = findAllKeys(dic_WMandDescription_Excel)

keys_WMandDescription_Both = list(set(keys_WMandDescription_Model + keys_WMandDescription_Excel))
values_WMandDescription_Both = []
for i in keys_WMandDescription_Both:
    if i in keys_WMandDescription_Model:
        values_WMandDescription_Both.append(dic_WMandDescription_Model[i])
    else:
        values_WMandDescription_Both.append(dic_WMandDescription_Excel[i])

dic_WMandDescription_Both = {}
for i in range(len(keys_WMandDescription_Both)):
    dic_WMandDescription_Both[keys_WMandDescription_Both[i]] = values_WMandDescription_Both[i]

workMasterCodePerElementFromBoth = []
for i in range(len(workMasterCodePerElement)):
    #tmp = []
    a = WMPerElementFromModeling[i] + workMasterCodePerElement[i]
    b = findUnique(a)
    workMasterCodePerElementFromBoth.append(b)

specPerElement = []
for i in workMasterCodePerElementFromBoth:
    tmp = []
    for j in i:
        tmp.append(dic_WMandDescription_Both[j])
    specPerElement.append(tmp)

fullWMCodeDescriptionPerElement = []
for i in range(len(workMasterCodePerElementFromBoth)):
    tmp = []
    for j in range(len(workMasterCodePerElementFromBoth[i])):
        a = workMasterCodePerElementFromBoth[i][j] +": "+ specPerElement[i][j]
        tmp.append(a)
    fullWMCodeDescriptionPerElement.append(tmp)

fullWMinfo = {
"AllElement": inputElements,
"WorkMasterCodePerFamilyType": dic_FamilyCodeandWM,
"WorkMasterCodePerElementBoth": workMasterCodePerElementFromBoth,
"FullWMCodeDescriptionPerElement": fullWMCodeDescriptionPerElement
}



result = fullWMinfo

# Assign your output to the OUT variable.
OUT = result
# ----------------------------------------
library = Python()  # CPython3; unwired: IN[0]
# ---------- library.python (129 lines) ----------
# Load the Python Standard and DesignScript Libraries
import os
import sys
sys.path.append(os.getenv('LOCALAPPDATA').replace('\\','\\\\') + r'\Programs\Python\Python39\Lib\site-packages')
import clr
clr.AddReference('RevitAPI')
import Autodesk

clr.AddReference('ProtoGeometry')
from Autodesk.DesignScript.Geometry import *

clr.AddReference('RevitNodes')
import Revit
clr.ImportExtensions(Revit.Elements)

clr.ImportExtensions(Revit.GeometryConversion)
clr.ImportExtensions(Revit.GeometryReferences)

clr.AddReference('RevitServices')
import RevitServices
from RevitServices.Persistence import DocumentManager
from RevitServices.Transactions import TransactionManager

doc = DocumentManager.Instance.CurrentDBDocument

import random
import itertools
from functools import reduce

# The inputs to this node will be stored as a list in the IN variables.
dataEnteringNode = IN

# Place your code below this line
class ConvexHull_Maker:
    def __init__(self, points):
        def convex_hull_graham(points):
            def ToVals(pt):
	            return [pt.X,pt.Y,pt.Z]
            def ToPts(ptVals):
	            return Point.ByCoordinates(ptVals[0],ptVals[1],ptVals[2])
	           
            def CreateOutline(pts):
                crvs = []
                i = 0
                while i < len(pts):
                    if i == len(pts)-1:
                        crvs.append(Line.ByStartPointEndPoint(pts[i],pts[0]))
                    else:
                        crvs.append(Line.ByStartPointEndPoint(pts[i],pts[i+1]))
                    i = i+1
                return PolyCurve.ByJoinedCurves(crvs)
	
            TURN_LEFT, TURN_RIGHT, TURN_NONE = (1, -1, 0)

            def cmp(a, b):
                return (a > b) - (a < b)
	
            def turn(p, q, r):
                return cmp((q[0] - p[0])*(r[1] - p[1]) - (r[0] - p[0])*(q[1] - p[1]), 0)
	
            def _keep_left(hull, r):
                while len(hull) > 1 and turn(hull[-2], hull[-1], r) != TURN_LEFT:
                    hull.pop()
                if not len(hull) or hull[-1] != r:
                    hull.append(r)
                return hull

            points = [ToVals(p) for p in points]	
            points = sorted(points)
            l = reduce(_keep_left, points, [])
            u = reduce(_keep_left, reversed(points), [])
            points = l.extend(u[i] for i in range(1, len(u) - 1)) or l
            points = [ToPts(p) for p in points]
            return CreateOutline(points)
            
        self.points = points
        result = convex_hull_graham(points)
        self.result = result

def repeatFuncApply(func, repeat, data_input):
    result = []
    input_forFunc = data_input
    while repeat != 0:
        result.append(func(input_forFunc))
        input_forFunc = func(input_forFunc)
        repeat = repeat - 1
    return result

def create_horizonLine(endpt):
    sttpt = Point.ByCoordinates(0,0,0)
    line_prime = Line.ByStartPointEndPoint(sttpt, endpt)
    return line_prime
    
def create_verticalLine(endpt):
    sttpt = Point.ByCoordinates(0,0,0)
    line_prime = Line.ByStartPointEndPoint(sttpt, endpt)
    return line_prime
    
def curveOffset(elem, dist):
    result = Curve.Offset(elem, dist)
    return result
    
def range_q(start, end, num):
    result = [start]
    between = num - 1
    gap = end - start
    step = gap / between
    for i in range(num):
        if i == 0:
            pass
        else:
            target = start + step * i
            result.append(target)
    return result



##########################################################
result = [
ConvexHull_Maker,
repeatFuncApply,
create_horizonLine,
create_verticalLine,
curveOffset,
range_q
]	

# Assign your output to the OUT variable.
OUT = result
# ----------------------------------------
