# Dynamo graph 03 Str Column Calculator_HEC(1102).dyn (Dynamo 2.10.1.3976)

# group: 현재 카테고리 내에 적용될 Total WM code
file_path = Filename("..\dyn_test\wmCodeAll.xlsx")
file_from_path = FileObject()  # unwired: path
code_block = CodeBlock { "wmCodeAll"; }
code_block_2 = CodeBlock { false; }
importExcel = Data.ImportExcel(file=file_from_path, sheetName=code_block, showExcel=code_block_2)
transpose = List.Transpose(lists=importExcel)
count = List.Count(list=transpose)
file_path_2 = Filename(".\1.txt")
code_block_3 = CodeBlock { "..."; }
code_block_4 = CodeBlock { " "; }
isNull = Object.IsNull()  # unwired: object
replaceByCondition = Replace(item=transpose, replaceWith=code_block_4, condition=isNull)
code_block_5 = CodeBlock(i=replaceByCondition) { i[0]+"_"+i[1]+"_"+i[2]+"_"+i[3]; }
join = String.Join(separator=code_block_3, string0=code_block_5)
writeText = FileSystem.WriteText(filePath=file_path_2, text=join)
code_block_6 = CodeBlock(i=replaceByCondition) { i[0]; }
현재_카테고리_내에서_쓰일_total_wm_code = CodeBlock()
# ---------- 현재_카테고리_내에서_쓰일_total_wm_code.designscript (18 lines) ----------
i = [

"A03AC032",
"A03AC033",
"A03AC035",
"A03AC036",
"A03AC037",
"A03AE056",
"A03AE057",
"A03AE058",
"A03AE059",
"A03AE060",
"A03AE061",
"A03AH062",
"A03AH058",
"A03AH063"

];
# ----------------------------------------
indexOf = List.IndexOf(list=code_block_6, element=현재_카테고리_내에서_쓰일_total_wm_code)
getItemAtIndex = List.GetItemAtIndex(list=code_block_5, index=indexOf)  # frozen

# group: select all Category element
categories = Categories("OST_StructuralColumns")
all_elements_of_category = ElementsOfCategory()  # unwired: Category
code_block_7 = CodeBlock { "Base Level"; }
parameterByName = Parameter.ParameterByName(element=all_elements_of_category, name=code_block_7)
string_from_object = FromObject(object=parameterByName)
uniqueItems = List.UniqueItems(list=string_from_object)
code_block_8 = CodeBlock(i=string_from_object, j=uniqueItems) { i == j[0]; }
filterByBoolMask = List.FilterByBoolMask(list=all_elements_of_category, mask=code_block_8)

# group: 변수 확인 용
parameters = Element.Parameters(element=all_elements_of_category)
string_from_object_2 = FromObject(object=parameters)
code_block_9 = CodeBlock(i=string_from_object_2) { i[0][6]; }

code_block_10 = CodeBlock {  }

# group: Str Columns
code_block_11 = CodeBlock {  }
code_block_12 = CodeBlock {  }

geometry = Element.Geometry()  # unwired: element
watch = Watch(all_elements_of_category)
name = FamilyType.Name(familyType=watch)
watch_2 = Watch(name)
string_from_object_3 = FromObject(object=watch_2)
code_block_13 = CodeBlock { "H-"; }
contains = String.Contains(str=string_from_object_3, searchFor=code_block_13)
filterByBoolMask_2 = List.FilterByBoolMask(list=all_elements_of_category, mask=contains)
watch_3 = Watch(filterByBoolMask_2.out)
geometry_2 = Element.Geometry(element=watch_3)
code_block_14 = CodeBlock(i=watch_3) { i; }

# group: All solids
geometry_3 = Element.Geometry(element=code_block_14)

# group: Volume 검토
volume = Solid.Volume(solid=geometry_3)
watch_4 = Watch(volume)
code_block_15 = CodeBlock { "Volume"; }
getParameterValueByName = Element.GetParameterValueByName(element=code_block_14, parameterName=code_block_15)
watch_5 = Watch(getParameterValueByName)

# group: con'c ratio x
code_block_16 = CodeBlock(a=watch_5) { a*0.1; }
watch_6 = Watch(code_block_16)

# group: con'c ratio x
code_block_17 = CodeBlock { a*0.1; }  # unwired: a
watch_7 = Watch(code_block_17)

watch_8 = Watch(filterByBoolMask_2.in)
code_block_18 = CodeBlock(o=watch_8) { o; }

# group: All solids
geometry_4 = Element.Geometry(element=code_block_18)

elementType = Element.ElementType(element=code_block_18)

# group: Volume 검토
volume_2 = Solid.Volume(solid=geometry_4)
watch_9 = Watch(volume_2)
code_block_19 = CodeBlock { "Unit Weight"; }
getParameterValueByName_2 = Element.GetParameterValueByName(element=elementType, parameterName=code_block_19)
watch_10 = Watch(getParameterValueByName_2)

# group: 조금더 많은 element sample에서 test 30<a<90 관련 풀이 확인 후 적용
code_block_20 = CodeBlock(a=watch_10) { a>90; a<30; }
watch_11 = Watch(code_block_20.out1)
watch_12 = Watch(code_block_20.out0)
filterByBoolMask_3 = List.FilterByBoolMask(list=code_block_18, mask=watch_12)

# group: Base Plate 모델링 추가분 sample 에서 test
code_block_21 = CodeBlock {  }

현재_카테고리_내에서_쓰일_total_wm_full = CodeBlock(codeAll=getItemAtIndex) { codeAll; }  # "현재 카테고리 내에서 쓰일 Total WM full code"

# group: 거푸집 관련 WM 추출
현재_카테고리_내에서_쓰일_total_wm_code_2 = CodeBlock(codeAll=현재_카테고리_내에서_쓰일_total_wm_full) { codeAll; }
code_block_22 = CodeBlock()
# ---------- code_block_22.designscript (5 lines) ----------
[

"Form"

];
# ----------------------------------------
code_block_23 = CodeBlock(str=현재_카테고리_내에서_쓰일_total_wm_code_2, searchFor=code_block_22) { String.Contains(str<1>, searchFor, false); }
allFalse = List.AllFalse(list=code_block_23@L2)
code_block_24 = CodeBlock { false; }
allIndicesOf = List.AllIndicesOf(list=allFalse, item=code_block_24)
getItemAtIndex_2 = List.GetItemAtIndex(list=현재_카테고리_내에서_쓰일_total_wm_code_2, index=allIndicesOf)

# group: All faces
faces = Element.Faces(element=code_block_14)

# group: side face for A03AC035, A03AC036 (Form Work)
code_block_25 = CodeBlock { 0.5; }
normalAtParameter = Surface.NormalAtParameter(surface=faces, u=code_block_25, v=code_block_25)
Z = Vector.Z(vector=normalAtParameter)
code_block_26 = CodeBlock(i=Z) { i == 1 ||i == -1? false:true; }
filterByBoolMask_4 = List.FilterByBoolMask(list=faces, mask=code_block_26)

# group: calculation
area = Surface.Area(surface=filterByBoolMask_4.in)
code_block_27 = CodeBlock(num1=area) { num2 = Math.Sum(num1)/1000000; }

# group: instanace 별 wm 및 wm 물량값 매칭
code_block_28 = CodeBlock { "..."; }
join_2 = String.Join(separator=code_block_28)  # unwired: string0, string1
instance_별_계산값 = CodeBlock(i=code_block_27) { i; }
string_from_object_4 = FromObject(object=instance_별_계산값)
cartesianProduct = List.CartesianProduct(combineFunction=join_2, list0=getItemAtIndex_2, list1=string_from_object_4)
transpose_2 = List.Transpose(lists=cartesianProduct)

# group: 구체(RC) 관련 WM 추출
현재_카테고리_내에서_쓰일_total_wm_code_3 = CodeBlock(codeAll=현재_카테고리_내에서_쓰일_total_wm_full) { codeAll; }
code_block_29 = CodeBlock()
# ---------- code_block_29.designscript (6 lines) ----------
[

"Structural Concrete",
"Colored Concrete"

];
# ----------------------------------------
code_block_30 = CodeBlock(str=현재_카테고리_내에서_쓰일_total_wm_code_3, searchFor=code_block_29) { String.Contains(str<1>, searchFor, false); }
allFalse_2 = List.AllFalse(list=code_block_30@L2)
code_block_31 = CodeBlock { false; }
allIndicesOf_2 = List.AllIndicesOf(list=allFalse_2, item=code_block_31)
# note: 1 line text export
getItemAtIndex_3 = List.GetItemAtIndex(list=현재_카테고리_내에서_쓰일_total_wm_code_3, index=allIndicesOf_2)

# group: solids for A03AC032, A03AC033 (concrete)
solids_for_a03ac032_a03ac033 = CodeBlock(i=geometry_3) { i; }  # "solids for A03AC032, A03AC033 (concrete)"

# group: calculation
flatten = List.Flatten(list=solids_for_a03ac032_a03ac033)
code_block_32 = CodeBlock(i=flatten) { Solid.Volume(i)/1000000000; }

# group: instanace 별 wm 및 wm 물량값 매칭
code_block_33 = CodeBlock { "..."; }
join_3 = String.Join(separator=code_block_33)  # unwired: string0, string1
instance_별_계산값_2 = CodeBlock(i=code_block_32) { i; }
string_from_object_5 = FromObject(object=instance_별_계산값_2)
cartesianProduct_2 = List.CartesianProduct(combineFunction=join_3, list0=getItemAtIndex_3, list1=string_from_object_5)
transpose_3 = List.Transpose(lists=cartesianProduct_2)

# group: Protective Coating 관련 WM 추출
현재_카테고리_내에서_쓰일_total_wm_code_4 = CodeBlock(codeAll=현재_카테고리_내에서_쓰일_total_wm_full) { codeAll; }
code_block_34 = CodeBlock()
# ---------- code_block_34.designscript (5 lines) ----------
[

"Concrete Protective Coating (U/G)"

];
# ----------------------------------------
code_block_35 = CodeBlock(str=현재_카테고리_내에서_쓰일_total_wm_code_4, searchFor=code_block_34) { String.Contains(str<1>, searchFor, false); }
allFalse_3 = List.AllFalse(list=code_block_35@L2)
code_block_36 = CodeBlock { false; }
allIndicesOf_3 = List.AllIndicesOf(list=allFalse_3, item=code_block_36)
getItemAtIndex_4 = List.GetItemAtIndex(list=현재_카테고리_내에서_쓰일_total_wm_code_4, index=allIndicesOf_3)

# group: side face for A03AE056, A03AE057, A03AE058, A03AE059, A03AE060, A03AE061 (UG coating)
code_block_37 = CodeBlock { 0.5; }
normalAtParameter_2 = Surface.NormalAtParameter(surface=faces, u=code_block_37, v=code_block_37)
Z_2 = Vector.Z(vector=normalAtParameter_2)
code_block_38 = CodeBlock(i=Z_2) { i == 1 ||i == -1? false:true; }
filterByBoolMask_5 = List.FilterByBoolMask(list=faces, mask=code_block_38)

# group: calculation
area_2 = Surface.Area(surface=filterByBoolMask_5.in)
code_block_39 = CodeBlock(num1=area_2) { num2 = Math.Sum(num1)/1000000; }

# group: instanace 별 wm 및 wm 물량값 매칭
code_block_40 = CodeBlock { "..."; }
join_4 = String.Join(separator=code_block_40)  # unwired: string0, string1
instance_별_계산값_3 = CodeBlock(i=code_block_39) { i; }
string_from_object_6 = FromObject(object=instance_별_계산값_3)
cartesianProduct_3 = List.CartesianProduct(combineFunction=join_4, list0=getItemAtIndex_4, list1=string_from_object_6)
transpose_4 = List.Transpose(lists=cartesianProduct_3)

# group: export to excel
file_path_3 = Filename("C:\Users\HEC\Desktop\11.xlsx")
code_block_41 = CodeBlock { "Sheet1"; }
code_block_42 = CodeBlock { 1; }
code_block_43 = CodeBlock { true; }
exportExcel = Data.ExportExcel(filePath=file_path_3, sheetName=code_block_41, startRow=code_block_42, startCol=code_block_42, overWrite=code_block_43)  # unwired: data

현재_카테고리_내에서_쓰일_total_wm_full_2 = CodeBlock(codeAll=getItemAtIndex) { codeAll; }  # "현재 카테고리 내에서 쓰일 Total WM full code"

# group: 거푸집 관련 WM 추출
현재_카테고리_내에서_쓰일_total_wm_code_5 = CodeBlock(codeAll=현재_카테고리_내에서_쓰일_total_wm_full_2) { codeAll; }
code_block_44 = CodeBlock()  # same code as code_block_22
code_block_45 = CodeBlock(str=현재_카테고리_내에서_쓰일_total_wm_code_5, searchFor=code_block_44) { String.Contains(str<1>, searchFor, false); }
allFalse_4 = List.AllFalse(list=code_block_45@L2)
code_block_46 = CodeBlock { false; }
allIndicesOf_4 = List.AllIndicesOf(list=allFalse_4, item=code_block_46)
getItemAtIndex_5 = List.GetItemAtIndex(list=현재_카테고리_내에서_쓰일_total_wm_code_5, index=allIndicesOf_4)

# group: All faces
faces_2 = Element.Faces(element=code_block_18)

# group: side face for A03AC035, A03AC036 (Form Work)
code_block_47 = CodeBlock { 0.5; }
normalAtParameter_3 = Surface.NormalAtParameter(surface=faces_2, u=code_block_47, v=code_block_47)
Z_3 = Vector.Z(vector=normalAtParameter_3)
code_block_48 = CodeBlock(i=Z_3) { i == 1 ||i == -1? false:true; }
filterByBoolMask_6 = List.FilterByBoolMask(list=faces_2, mask=code_block_48)

# group: calculation
area_3 = Surface.Area(surface=filterByBoolMask_6.in)
code_block_49 = CodeBlock(num1=area_3) { num2 = Math.Sum(num1)/1000000; }

# group: instanace 별 wm 및 wm 물량값 매칭
code_block_50 = CodeBlock { "..."; }
join_5 = String.Join(separator=code_block_50)  # unwired: string0, string1
instance_별_계산값_4 = CodeBlock(i=code_block_49) { i; }
string_from_object_7 = FromObject(object=instance_별_계산값_4)
cartesianProduct_4 = List.CartesianProduct(combineFunction=join_5, list0=getItemAtIndex_5, list1=string_from_object_7)
transpose_5 = List.Transpose(lists=cartesianProduct_4)

# group: 구체(RC) 관련 WM 추출
현재_카테고리_내에서_쓰일_total_wm_code_6 = CodeBlock(codeAll=현재_카테고리_내에서_쓰일_total_wm_full_2) { codeAll; }
code_block_51 = CodeBlock()  # same code as code_block_29
code_block_52 = CodeBlock(str=현재_카테고리_내에서_쓰일_total_wm_code_6, searchFor=code_block_51) { String.Contains(str<1>, searchFor, false); }
allFalse_5 = List.AllFalse(list=code_block_52@L2)
code_block_53 = CodeBlock { false; }
allIndicesOf_5 = List.AllIndicesOf(list=allFalse_5, item=code_block_53)
getItemAtIndex_6 = List.GetItemAtIndex(list=현재_카테고리_내에서_쓰일_total_wm_code_6, index=allIndicesOf_5)

# group: solids for A03AC032, A03AC033 (concrete)
solids_for_a03ac032_a03ac033_2 = CodeBlock(i=geometry_4) { i; }  # "solids for A03AC032, A03AC033 (concrete)"

# group: calculation
flatten_2 = List.Flatten(list=solids_for_a03ac032_a03ac033_2)
code_block_54 = CodeBlock(i=flatten_2) { Solid.Volume(i)/1000000000; }

# group: instanace 별 wm 및 wm 물량값 매칭
code_block_55 = CodeBlock { "..."; }
join_6 = String.Join(separator=code_block_55)  # unwired: string0, string1
instance_별_계산값_5 = CodeBlock(i=code_block_54) { i; }
string_from_object_8 = FromObject(object=instance_별_계산값_5)
cartesianProduct_5 = List.CartesianProduct(combineFunction=join_6, list0=getItemAtIndex_6, list1=string_from_object_8)
transpose_6 = List.Transpose(lists=cartesianProduct_5)

# group: Protective Coating 관련 WM 추출
현재_카테고리_내에서_쓰일_total_wm_code_7 = CodeBlock(codeAll=현재_카테고리_내에서_쓰일_total_wm_full_2) { codeAll; }
code_block_56 = CodeBlock()
# ---------- code_block_56.designscript (5 lines) ----------
[

"Concrete Protective Coating (A/G)"

];
# ----------------------------------------
code_block_57 = CodeBlock(str=현재_카테고리_내에서_쓰일_total_wm_code_7, searchFor=code_block_56) { String.Contains(str<1>, searchFor, false); }
allFalse_6 = List.AllFalse(list=code_block_57@L2)
code_block_58 = CodeBlock { false; }
allIndicesOf_6 = List.AllIndicesOf(list=allFalse_6, item=code_block_58)
getItemAtIndex_7 = List.GetItemAtIndex(list=현재_카테고리_내에서_쓰일_total_wm_code_7, index=allIndicesOf_6)

# group: side face for A03AE056, A03AE057, A03AE058, A03AE059, A03AE060, A03AE061 (UG coating)
code_block_59 = CodeBlock { 0.5; }
normalAtParameter_4 = Surface.NormalAtParameter(surface=faces_2, u=code_block_59, v=code_block_59)
Z_4 = Vector.Z(vector=normalAtParameter_4)
code_block_60 = CodeBlock(i=Z_4) { i == 1 ||i == -1? false:true; }
filterByBoolMask_7 = List.FilterByBoolMask(list=faces_2, mask=code_block_60)

# group: calculation
area_4 = Surface.Area(surface=filterByBoolMask_7.in)
code_block_61 = CodeBlock(num1=area_4) { num2 = Math.Sum(num1)/1000000; }

# group: instanace 별 wm 및 wm 물량값 매칭
code_block_62 = CodeBlock { "..."; }
join_7 = String.Join(separator=code_block_62)  # unwired: string0, string1
instance_별_계산값_6 = CodeBlock(i=code_block_61) { i; }
string_from_object_9 = FromObject(object=instance_별_계산값_6)
cartesianProduct_6 = List.CartesianProduct(combineFunction=join_7, list0=getItemAtIndex_7, list1=string_from_object_9)
transpose_7 = List.Transpose(lists=cartesianProduct_6)

code_block_63 = CodeBlock {  }
code_block_64 = CodeBlock { "..."; }
join_8 = String.Join(separator=code_block_64)  # unwired: string0, string1

# group: 인스턴스 이름과 위치 정보
code_block_65 = CodeBlock(i=code_block_14) { i; }
code_block_66 = CodeBlock { "Type"; }
getParameterValueByName_3 = Element.GetParameterValueByName(element=code_block_65, parameterName=code_block_66)
code_block_67 = CodeBlock { "Base Level"; }
getParameterValueByName_4 = Element.GetParameterValueByName(element=code_block_65, parameterName=code_block_67)
string_from_object_10 = FromObject(object=getParameterValueByName_4)
code_block_68 = CodeBlock { ", "; }
split = String.Split(str=string_from_object_10, separator0=code_block_68)
code_block_69 = CodeBlock { -1; }
takeItems = List.TakeItems(list=split@L2, amount=code_block_69)
code_block_70 = CodeBlock(i=takeItems) { String.Length(i)-1; }
code_block_71 = CodeBlock { -1; }
remove = String.Remove(string=takeItems, startIndex=code_block_70, count=code_block_71)
flatten_3 = List.Flatten(list=remove)
code_block_72 = CodeBlock { "Column Location Mark"; }
getParameterValueByName_5 = Element.GetParameterValueByName(element=code_block_65, parameterName=code_block_72)
string_from_object_11 = FromObject(object=getParameterValueByName_5)
code_block_73 = CodeBlock(i=getParameterValueByName_3, j=flatten_3, k=string_from_object_11) { i+"..."+j+"..."+k; }

code_block_74 = CodeBlock(i=code_block_73) { i; }
code_block_75 = CodeBlock(t1=cartesianProduct_2, t2=cartesianProduct, t3=cartesianProduct_3) { q = List.Join([t1<1>, t2<1>, t3<1>]); }
count_2 = List.Count(list=code_block_75)
python_script = Python(IN[0]=code_block_74, IN[1]=count_2)  # IronPython2
# ---------- python_script.python (20 lines) ----------
# Load the Python Standard and DesignScript Libraries
import sys
import clr
clr.AddReference('ProtoGeometry')
from Autodesk.DesignScript.Geometry import *

# The inputs to this node will be stored as a list in the IN variables.
dataEnteringNode = IN
inputList = IN[0]
cycleCnt = IN[1]
outlist = []

# Place your code below this line

for i in inputList:
	for j in range(cycleCnt):
		outlist.append(i)

# Assign your output to the OUT variable.
OUT = outlist
# ----------------------------------------
transpose_8 = List.Transpose(lists=code_block_75)
flatten_4 = List.Flatten(list=transpose_8)
laceShortest = List.LaceShortest(combineFunction=join_8, list0=python_script, list1=flatten_4)
code_block_76 = CodeBlock { "..."; }
split_2 = String.Split(str=laceShortest, separator0=code_block_76)
code_block_77 = CodeBlock { "..."; }
join_9 = String.Join(separator=code_block_77)  # unwired: string0, string1

# group: 인스턴스 이름과 위치 정보
code_block_78 = CodeBlock(i=code_block_18) { i; }
code_block_79 = CodeBlock { "Type"; }
getParameterValueByName_6 = Element.GetParameterValueByName(element=code_block_78, parameterName=code_block_79)
code_block_80 = CodeBlock { "Base Level"; }
getParameterValueByName_7 = Element.GetParameterValueByName(element=code_block_78, parameterName=code_block_80)
string_from_object_12 = FromObject(object=getParameterValueByName_7)
code_block_81 = CodeBlock { ", "; }
split_3 = String.Split(str=string_from_object_12, separator0=code_block_81)
code_block_82 = CodeBlock { -1; }
takeItems_2 = List.TakeItems(list=split_3@L2, amount=code_block_82)
code_block_83 = CodeBlock(i=takeItems_2) { String.Length(i)-1; }
code_block_84 = CodeBlock { -1; }
remove_2 = String.Remove(string=takeItems_2, startIndex=code_block_83, count=code_block_84)
flatten_5 = List.Flatten(list=remove_2)
code_block_85 = CodeBlock { "Column Location Mark"; }
getParameterValueByName_8 = Element.GetParameterValueByName(element=code_block_78, parameterName=code_block_85)
string_from_object_13 = FromObject(object=getParameterValueByName_8)
code_block_86 = CodeBlock(i=getParameterValueByName_6, j=flatten_5, k=string_from_object_13) { i+"..."+j+"..."+k; }

code_block_87 = CodeBlock(i=code_block_86) { i; }
code_block_88 = CodeBlock(t1=cartesianProduct_5, t2=cartesianProduct_4, t3=cartesianProduct_6) { q = List.Join([t1<1>, t2<1>, t3<1>]); }
count_3 = List.Count(list=code_block_88)
python_script_2 = Python(IN[0]=code_block_87, IN[1]=count_3)  # IronPython2; same code as python_script
transpose_9 = List.Transpose(lists=code_block_88)
flatten_6 = List.Flatten(list=transpose_9)
laceShortest_2 = List.LaceShortest(combineFunction=join_9, list0=python_script_2, list1=flatten_6)
code_block_89 = CodeBlock { "..."; }
split_4 = String.Split(str=laceShortest_2, separator0=code_block_89)
join_10 = List.Join(list0=split_2, list1=split_4)

# group: All solids
geometry_5 = Element.Geometry(element=code_block_18)

explode = Geometry.Explode(geometry=geometry_5)
flatten_7 = List.Flatten(list=explode)
code_block_90 = CodeBlock { 0.5; }
normalAtParameter_5 = Surface.NormalAtParameter(surface=flatten_7, u=code_block_90, v=code_block_90)
Z_5 = Vector.Z(vector=normalAtParameter_5@L2)
code_block_91 = CodeBlock { 2; }
round = Math.Round(number=Z_5, digits=code_block_91)
code_block_92 = CodeBlock(a=round) { a==0; a>0; a<0; a==-1; }
filterByBoolMask_8 = List.FilterByBoolMask(list=flatten_7, mask=code_block_92.out1@L2)
flatten_8 = List.Flatten(list=filterByBoolMask_8.in)
byGeometry = BoundingBox.ByGeometry(geom=flatten_8@L1)
toCuboid = BoundingBox.ToCuboid(boundingBox=byGeometry)
explode_2 = Geometry.Explode(geometry=toCuboid)
perimeterCurves = Surface.PerimeterCurves(surface=explode_2)
startPoint = Curve.StartPoint(curve=perimeterCurves)
boolean = BoolSelector(true)
byPoints = PolyCurve.ByPoints(points=startPoint, connectLastToFirst=boolean)
code_block_93 = CodeBlock { 50; }
offset = Curve.Offset(curve=byPoints, distance=code_block_93)
ZAxis = Vector.ZAxis()
reverse = Vector.Reverse(vector=ZAxis)
code_block_94 = CodeBlock { "Length"; }
getParameterValueByName_9 = Element.GetParameterValueByName(element=code_block_18, parameterName=code_block_94)
watch_13 = Watch(getParameterValueByName_9)
extrudeAsSolid = Curve.ExtrudeAsSolid(curve=offset, direction=reverse, distance=watch_13)
watch_14 = Watch(extrudeAsSolid)
watch_15 = Watch(geometry_5)
differenceAll = Solid.DifferenceAll(solid=watch_14, others=watch_15, lacing=Shortest)
volume_3 = Solid.Volume(solid=differenceAll)
watch_16 = Watch(volume_3)
flatten_9 = List.Flatten(list=filterByBoolMask_8.in)
perimeterCurves_2 = Surface.PerimeterCurves(surface=flatten_9)
startPoint_2 = Curve.StartPoint(curve=perimeterCurves_2)
boolean_2 = BoolSelector(true)
byPoints_2 = PolyCurve.ByPoints(points=startPoint_2, connectLastToFirst=boolean_2)
code_block_95 = CodeBlock { 0; }
offset_2 = Curve.Offset(curve=byPoints_2, distance=code_block_95)

# group: 접한 요소와의 공재 범위 확인 필요
ZAxis_2 = Vector.ZAxis()
reverse_2 = Vector.Reverse(vector=ZAxis_2)
extrudeAsSolid_2 = Curve.ExtrudeAsSolid(curve=offset_2, direction=reverse_2, distance=watch_13)
area_5 = Solid.Area(solid=extrudeAsSolid_2)
extrude = Curve.Extrude(curve=offset_2, direction=reverse_2, distance=watch_13)
area_6 = Surface.Area(surface=extrude)

code_block_96 = CodeBlock { i; }  # unwired: i

# group: Input Manager
value_for_import_from_others = CodeBlock(MainInput=code_block_96) { MainInput; RefInput1; RefInput2; }  # unwired: RefInput1, RefInput2

# group: <Func 9>Lean Concrete
code_block_97 = CodeBlock { "TargetElements"; }
valueAtKey = DesignScript.Builtin.Dictionary.ValueAtKey(dictionary=value_for_import_from_others.MainInput, key=code_block_97)
code_block_98 = CodeBlock { 0; 100; }
# note: <Func>
createLeanConcrete = Custom[CreateLeanConcrete](Element=valueAtKey, leanOffset=code_block_98.out0, leanThick=code_block_98.out1)  # CreateLeanConcreteForISOFDN
volume_4 = Solid.Volume(solid=createLeanConcrete.Solid)
code_block_99 = CodeBlock(i=volume_4) { Math.Round(List.Flatten(i)/1000000000, 2); }
code_block_100 = CodeBlock { "M3"; }
count_4 = List.Count(list=code_block_99)
ofRepeatedItem = List.OfRepeatedItem(item=code_block_100, amount=count_4)
code_block_101 = CodeBlock(FuncValues=code_block_99, FuncValuesUnit=ofRepeatedItem)
# ---------- code_block_101.designscript (4 lines) ----------
{
"FuncValues": _FuncValues,
"FuncValuesUnit": _FuncValuesUnit
};
# ----------------------------------------

# group: Output Manager
reference_output = CodeBlock(ref=createLeanConcrete.Solid) { ref; }
output = CodeBlock(MainOutput=code_block_101, RefOutput_geoColor=createLeanConcrete.Solid) { MainOutput; RefOutput_geoColor; }

# group: Input Manager
value_for_import_from_others_2 = CodeBlock(MainInput=code_block_96, RefInput1=reference_output) { MainInput; RefInput1; RefInput2; }  # unwired: RefInput2

# group: <Func 4> Excavation (SOG 한정)
flatten_10 = List.Flatten(list=value_for_import_from_others_2.RefInput1)
하부_surface_추출 = Python(IN[0]=flatten_10)  # CPython3
# ---------- 하부_surface_추출.python (26 lines) ----------
# Load the Python Standard and DesignScript Libraries
import sys
import clr
import itertools
clr.AddReference('ProtoGeometry')
from Autodesk.DesignScript.Geometry import *

# The inputs to this node will be stored as a list in the IN variables.
dataEnteringNode = IN
input_elements = IN[0]

# Place your code below this line

srfs_input_elements = list(map(lambda x: x.Explode(), input_elements))

#srfs_input_flatten = list(itertools.chain(*srfs_input_elements))

def func_findZ_normalAtParma(srf):
    return srf.NormalAtParameter(0.5,0.5).Z
srfs_below = list(map(lambda y: filter(lambda x: func_findZ_normalAtParma(x) == -1, y), srfs_input_elements))

result = srfs_below


# Assign your output to the OUT variable.
OUT = result
# ----------------------------------------
flatten_11 = List.Flatten(list=하부_surface_추출)
perimeterCurves_3 = Surface.PerimeterCurves(surface=flatten_11)
byJoinedCurves = PolyCurve.ByJoinedCurves(curves=perimeterCurves_3)
code_block_102 = CodeBlock { _ExcavOffsetBottom: var[]..[] = 300; }
offset_3 = Curve.Offset(curve=byJoinedCurves, distance=code_block_102)
flatten_12 = List.Flatten(list=offset_3)
levels = Levels("G.L")  # graph input
elevation = Level.Elevation(level=levels)
code_block_103 = CodeBlock { "TargetElements"; }
valueAtKey_2 = DesignScript.Builtin.Dictionary.ValueAtKey(dictionary=value_for_import_from_others_2.MainInput, key=code_block_103)
code_block_104 = CodeBlock { "Elevation at Bottom"; }
getParameterValueByName_10 = Element.GetParameterValueByName(element=valueAtKey_2, parameterName=code_block_104)
린_콘크리트_하부까지의_길이_추출_최하단 = Python(IN[0]=value_for_import_from_others_2.RefInput1)  # CPython3
# ---------- 린_콘크리트_하부까지의_길이_추출_최하단.python (22 lines) ----------
# Load the Python Standard and DesignScript Libraries
import sys
import clr
clr.AddReference('ProtoGeometry')
from Autodesk.DesignScript.Geometry import *

# The inputs to this node will be stored as a list in the IN variables.
dataEnteringNode = IN
inputs = IN[0]

# Place your code below this line

def findThickness(i):
    minPt_Z = BoundingBox.ByGeometry(i).MinPoint.Z
    maxPt_Z = BoundingBox.ByGeometry(i).MaxPoint.Z
    result = maxPt_Z - minPt_Z
    return result

thicknessByInput = list(map(findThickness, inputs))

# Assign your output to the OUT variable.
OUT = thicknessByInput
# ----------------------------------------
code_block_105 = CodeBlock(기초하단=getParameterValueByName_10, 린콘크리트하단=린_콘크리트_하부까지의_길이_추출_최하단) { 기초하단-린콘크리트하단; }
sub = elevation - code_block_105
flatten_13 = List.Flatten(list=sub)
translate = Geometry.Translate(geometry=offset_3, zTranslation=flatten_13)
경사_비율_입력_1_x_for_isofdn = DoubleInput(2)  # graph input
code_block_106 = CodeBlock(ElevationatBottom=flatten_13, 비율=경사_비율_입력_1_x_for_isofdn) { ElevationatBottom/비율; }
offset_4 = Curve.Offset(curve=translate, distance=code_block_106)
flatten_14 = List.Flatten(list=offset_4)
list_create = List.Create(item0=flatten_12, item1=flatten_14)
transpose_10 = List.Transpose(lists=list_create)
byLoft = Solid.ByLoft(crossSections=transpose_10)
터파기_형상_겹침_해소 = Python(IN[0]=byLoft)  # CPython3
# ---------- 터파기_형상_겹침_해소.python (29 lines) ----------
# Load the Python Standard and DesignScript Libraries
import sys
import clr
clr.AddReference('ProtoGeometry')
from Autodesk.DesignScript.Geometry import *

# The inputs to this node will be stored as a list in the IN variables.
dataEnteringNode = IN
inputs = IN[0]
result = []
# Place your code below this line

for x in range(len(inputs)):
    if x < len(inputs)-1:
        temp = []
        apply = inputs[x]
        for y in range(x,len(inputs)):
            if apply.DoesIntersect(inputs[y]):
                apply = apply.Split(inputs[y])[0]
                temp.append(apply)
            else:
                apply = apply
                temp.append(apply)
        result.append(temp[-1])
    elif x == len(inputs)-1:
        result.append(inputs[x])

# Assign your output to the OUT variable.
OUT = result
# ----------------------------------------
code_block_107 = CodeBlock(i=sub) { i<0?true:false; }
code_block_108 = CodeBlock { 0; }
volume_5 = Solid.Volume(solid=터파기_형상_겹침_해소)
code_block_109 = CodeBlock(i=volume_5) { Math.Round(List.Flatten(i)/1000000000, 2); }
if_ = If(test=code_block_107, true=code_block_108, false=code_block_109)
code_block_110 = CodeBlock { "M3"; }
count_5 = List.Count(list=code_block_109)
ofRepeatedItem_2 = List.OfRepeatedItem(item=code_block_110, amount=count_5)
code_block_111 = CodeBlock(FuncValues=if_, FuncValuesUnit=ofRepeatedItem_2)  # same code as code_block_101
color_palette = ColorPalette({R: 210, G: 105, B: 30, A: 135})
byGeometryColor = Modifiers.GeometryColor.ByGeometryColor(geometry=터파기_형상_겹침_해소, color=color_palette)
forRefOutput = CodeBlock(MainOutput=code_block_111, geoColor=byGeometryColor, 터파기형상=터파기_형상_겹침_해소)
# ---------- forRefOutput.designscript (5 lines) ----------
{
"MainOutput": MainOutput,
"geoColor": geoColor,
"터파기형상": 터파기형상
};
# ----------------------------------------

# group: Output Manager
reference_output_2 = CodeBlock(ref=터파기_형상_겹침_해소, ref2=if_) { ref; ref2; }
output_2 = CodeBlock(MainOutput=forRefOutput, RefOutput_geoColor=byGeometryColor) { MainOutput; RefOutput_geoColor; }

# group: Input Manager
value_for_import_from_others_3 = CodeBlock(MainInput=code_block_96, RefInput1=reference_output_2.ref2) { MainInput; RefInput1; RefInput2; }  # unwired: RefInput2

# group: <Func 6>Disposal
code_block_112 = CodeBlock { "TargetElements"; }
valueAtKey_3 = DesignScript.Builtin.Dictionary.ValueAtKey(dictionary=value_for_import_from_others_3.MainInput, key=code_block_112)
count_6 = List.Count(list=valueAtKey_3@L1)
code_block_113 = CodeBlock(i=value_for_import_from_others_3.RefInput1) { i==0?true:false; }
code_block_114 = CodeBlock { 0; }
# note: <Func>
if_2 = If(test=code_block_113, true=code_block_114, false=value_for_import_from_others_3.RefInput1)
code_block_115 = CodeBlock(i=if_2) { Math.Round(List.Flatten(i)/1000000000, 2); }
code_block_116 = CodeBlock { "M3"; }
count_7 = List.Count(list=code_block_115)
ofRepeatedItem_3 = List.OfRepeatedItem(item=code_block_116, amount=count_7)
code_block_117 = CodeBlock(FuncValues=code_block_115, FuncValuesUnit=ofRepeatedItem_3)  # same code as code_block_101

# group: Input Manager
value_for_import_from_others_4 = CodeBlock(MainInput=code_block_96) { MainInput; RefInput1; RefInput2; }  # unwired: RefInput1, RefInput2

# group: <Func 0> Hardner Finish (상부면)
code_block_118 = CodeBlock { "TargetElements"; }
# note: <Func>
valueAtKey_4 = DesignScript.Builtin.Dictionary.ValueAtKey(dictionary=value_for_import_from_others_4.MainInput, key=code_block_118)
flatten_15 = List.Flatten(list=valueAtKey_4)
# note: 일반화 여지가 있음
# (형상처리구간 + 물량계산 + 데이터 매칭)
extractUpperFacesOfElement = Custom[ExtractUpperFacesOfElement](Element=flatten_15)  # ExtractUpperFacesOfElement
area_7 = Surface.Area(surface=extractUpperFacesOfElement.Surface)
sum = Math.Sum(values=area_7)
code_block_119 = CodeBlock(i=sum) { Math.Round(List.Flatten(i)/1000000, 2); }
code_block_120 = CodeBlock { "M2"; }
count_8 = List.Count(list=code_block_119)
ofRepeatedItem_4 = List.OfRepeatedItem(item=code_block_120, amount=count_8)
code_block_121 = CodeBlock(FuncValues=code_block_119, FuncValuesUnit=ofRepeatedItem_4)  # same code as code_block_101
color_palette_2 = ColorPalette({R: 30, G: 144, B: 255, A: 129})
byGeometryColor_2 = Modifiers.GeometryColor.ByGeometryColor(geometry=extractUpperFacesOfElement.Surface, color=color_palette_2)

# group: Output Manager
reference_output_3 = CodeBlock { ref; }  # unwired: ref
output_3 = CodeBlock(MainOutput=code_block_121, RefOutput_geoColor=byGeometryColor_2) { MainOutput; RefOutput_geoColor; }

# group: <Func 6> Visual Manager
visual_켜기_끄기 = BoolSelector(false)
visual_manager = Python(IN[0]=output_3.RefOutput_geoColor, IN[1]=visual_켜기_끄기)  # CPython3
# ---------- visual_manager.python (18 lines) ----------
# Load the Python Standard and DesignScript Libraries
import sys
import clr
clr.AddReference('ProtoGeometry')
from Autodesk.DesignScript.Geometry import *

# The inputs to this node will be stored as a list in the IN variables.
dataEnteringNode = IN
geoColors = IN[0]
blnForVisual = IN[1]

# Place your code below this line
if blnForVisual == True:
    result = geoColors
else:
    result = 0
# Assign your output to the OUT variable.
OUT = result
# ----------------------------------------

# group: Primary Input
categories_2 = Categories("OST_StructuralColumns")
all_elements_of_category_2 = ElementsOfCategory(Category=categories_2)
file_path_4 = Filename("..\BIM_물량집계 자동화 산출기준표_rC(20211029).xlsx")
file_from_path_2 = FileObject(path=file_path_4)
code_block_122 = CodeBlock { "Str Columns"; }

# group: GetFull WMCodeDescription PerElement
getFullWMCodeDescriptionPerElement = Custom[GetFullWMCodeDescriptionPerElement](InputElement=all_elements_of_category_2, InputFilePath=file_from_path_2, InputSheetName=code_block_122)  # GetFullWMCodeDescriptionPerElement

# group: OrganizeAllElementInformAsDictionary
organizeAllElementInformAsDictionary = Custom[OrganizeAllElementInformAsDictionary](InputDic=getFullWMCodeDescriptionPerElement.Dictionary)  # OrganizeAllElementInformAsDictionary

# group: 사용된 패밀리 타입 종류 확인 구간
code_block_123 = CodeBlock { "FamilyCode"; }
valueAtKey_5 = DesignScript.Builtin.Dictionary.ValueAtKey(dictionary=organizeAllElementInformAsDictionary, key=code_block_123)
uniqueItems_2 = List.UniqueItems(list=valueAtKey_5)
watch_17 = Watch(uniqueItems_2)
code_block_124 = CodeBlock { "ElementType"; }
valueAtKey_6 = DesignScript.Builtin.Dictionary.ValueAtKey(dictionary=organizeAllElementInformAsDictionary, key=code_block_124)
uniqueItems_3 = List.UniqueItems(list=valueAtKey_6)
watch_18 = Watch(uniqueItems_3)

# group: Select Target Family Element And Connected WorkMasters
code_block_125 = CodeBlock { 0; }
selectTargetFamilyInformAsDictionary = Custom[SelectTargetFamilyInformAsDictionary](InputDic=organizeAllElementInformAsDictionary, InputIndex=code_block_125)  # Select Target Family Element And Connected WorkMasters

watch_19 = Watch(selectTargetFamilyInformAsDictionary)
components = DesignScript.Builtin.Dictionary.Components(dictionary=selectTargetFamilyInformAsDictionary)
watch_20 = Watch(components.values)
watch_21 = Watch(components.keys)
code_block_126 = CodeBlock(i=watch_21)
# ---------- code_block_126.designscript (2 lines) ----------
[i[0],
i[1]];
# ----------------------------------------

# group: Visual Manager
visual_켜기_끄기_2 = BoolSelector(false)
visual_manager_2 = Python(IN[0]=output_2.RefOutput_geoColor, IN[1]=visual_켜기_끄기_2)  # CPython3; same code as visual_manager

# group: Output Manager
reference_output_4 = CodeBlock { ref; }  # unwired: ref
output_4 = CodeBlock(MainOutput=code_block_117) { MainOutput; RefOutput_geoColor; }  # unwired: RefOutput_geoColor

# group: Visual Manager
visual_켜기_끄기_3 = BoolSelector(false)
visual_manager_3 = Python(IN[0]=output.RefOutput_geoColor, IN[1]=visual_켜기_끄기_3)  # CPython3; same code as visual_manager

# group: Input Manager
value_for_import_from_others_5 = CodeBlock(MainInput=code_block_96) { MainInput; RefInput1; RefInput2; }  # unwired: RefInput1, RefInput2

# group: <Func 1> Structural Concrete
code_block_127 = CodeBlock { "TargetElements"; }
valueAtKey_7 = DesignScript.Builtin.Dictionary.ValueAtKey(dictionary=value_for_import_from_others_5.MainInput, key=code_block_127)
# note: <Func>
geometry_6 = Element.Geometry(element=valueAtKey_7)
volume_6 = Solid.Volume(solid=geometry_6)
code_block_128 = CodeBlock(i=volume_6) { Math.Round(List.Flatten(i)/1000000000,2); }
code_block_129 = CodeBlock { "M3"; }
count_9 = List.Count(list=code_block_128)
ofRepeatedItem_5 = List.OfRepeatedItem(item=code_block_129, amount=count_9)
code_block_130 = CodeBlock(FuncValues=code_block_128, FuncValuesUnit=ofRepeatedItem_5)  # same code as code_block_101

# group: Output Manager
output_5 = CodeBlock(MainOutput=code_block_130) { MainOutput; RefOutput_geoColor; }  # unwired: RefOutput_geoColor
reference_output_5 = CodeBlock(ref=geometry_6) { ref; }

# group: Input Manager
value_for_import_from_others_6 = CodeBlock(MainInput=code_block_96) { MainInput; RefInput1; RefInput2; }  # unwired: RefInput1, RefInput2

# group: <Func 2> Form Works (Ground Slab 거푸집 필요X)
code_block_131 = CodeBlock { "TargetElements"; }
valueAtKey_8 = DesignScript.Builtin.Dictionary.ValueAtKey(dictionary=value_for_import_from_others_6.MainInput, key=code_block_131)
code_block_132 = CodeBlock { "Volume"; }
# note: <Func>
getParameterValueByName_11 = Element.GetParameterValueByName(element=valueAtKey_8, parameterName=code_block_132)
code_block_133 = CodeBlock(i=getParameterValueByName_11) { Math.Round(List.Flatten(i)/10000000,2); }
code_block_134 = CodeBlock { "M3"; }
count_10 = List.Count(list=code_block_133)
ofRepeatedItem_6 = List.OfRepeatedItem(item=code_block_134, amount=count_10)
code_block_135 = CodeBlock(FuncValues=code_block_133, FuncValuesUnit=ofRepeatedItem_6)  # same code as code_block_101

# group: Output Manager
reference_output_6 = CodeBlock { ref; }  # unwired: ref
output_6 = CodeBlock(MainOutput=code_block_135) { MainOutput; RefOutput_geoColor; }  # unwired: RefOutput_geoColor

# group: Input Manager
value_for_import_from_others_7 = CodeBlock(MainInput=code_block_96) { MainInput; RefInput1; RefInput2; }  # unwired: RefInput1, RefInput2

# group: <Func 3> PE Sheet
code_block_136 = CodeBlock { "TargetElements"; }
valueAtKey_9 = DesignScript.Builtin.Dictionary.ValueAtKey(dictionary=value_for_import_from_others_7.MainInput, key=code_block_136)
# note: <Func>
createLeanConcrete_2 = Custom[CreateLeanConcrete](Element=valueAtKey_9)
area_8 = Surface.Area(surface=createLeanConcrete_2.Surface)
code_block_137 = CodeBlock(i=area_8) { Math.Round(List.Flatten(i)/1000000, 2); }
code_block_138 = CodeBlock { "M2"; }
count_11 = List.Count(list=code_block_137)
ofRepeatedItem_7 = List.OfRepeatedItem(item=code_block_138, amount=count_11)
code_block_139 = CodeBlock(FuncValues=code_block_137, FuncValuesUnit=ofRepeatedItem_7)  # same code as code_block_101

# group: Output Manager
reference_output_7 = CodeBlock { ref; }  # unwired: ref
output_7 = CodeBlock(MainOutput=code_block_139) { MainOutput; RefOutput_geoColor; }  # unwired: RefOutput_geoColor

# group: Input Manager
value_for_import_from_others_8 = CodeBlock(MainInput=code_block_96, RefInput1=reference_output, RefInput2=reference_output_2.ref, RefInput3=reference_output_5) { MainInput; RefInput1; RefInput2; RefInput3; }

# group: <Func 2> Backfill
value_for_import_from_others_9 = CodeBlock(터파기형상=value_for_import_from_others_8.RefInput2) { 터파기형상; }
flatten_16 = List.Flatten(list=value_for_import_from_others_9)
volume_7 = Solid.Volume(solid=flatten_16)
watch_22 = Watch(volume_7)
code_block_140 = CodeBlock(i=watch_22) { Math.Round(List.Flatten(i)/1000000000, 2); }
code_block_141 = CodeBlock { "M3"; }
count_12 = List.Count(list=watch_22)
ofRepeatedItem_8 = List.OfRepeatedItem(item=code_block_141, amount=count_12)
# note: 터파기 물량ㅈ에서 콘크리트, 린 기둥 물량 빼기
code_block_142 = CodeBlock(FuncValues=code_block_140, FuncValuesUnit=ofRepeatedItem_8)  # same code as code_block_101
value_for_import_from_others_10 = CodeBlock(슬라브형상=value_for_import_from_others_8.RefInput3) { 슬라브형상; }
flatten_17 = List.Flatten(list=value_for_import_from_others_10)
doesIntersect = Geometry.DoesIntersect(geometry=flatten_16, other=flatten_17, lacing=CrossProduct)
filterByBoolMask_9 = List.FilterByBoolMask(list=flatten_17, mask=doesIntersect@L2)
flatten_18 = List.Flatten(list=filterByBoolMask_9.in)

# group: Output Manager
reference_output_8 = CodeBlock { ref; }  # unwired: ref
output_8 = CodeBlock(MainOutput=code_block_142) { MainOutput; RefOutput_geoColor; }  # unwired: RefOutput_geoColor

# group: Input Manager
value_for_import_from_others_11 = CodeBlock(MainInput=code_block_96) { MainInput; RefInput1; RefInput2; }  # unwired: RefInput1, RefInput2

# group: <Func 7>Base Course
code_block_143 = CodeBlock { "TargetElements"; }
valueAtKey_10 = DesignScript.Builtin.Dictionary.ValueAtKey(dictionary=value_for_import_from_others_11.MainInput, key=code_block_143)
# note: <Func>
createBaseCourseSurfaces = Custom[CreateBaseCourseSurfaces](Element=valueAtKey_10)  # CreateBaseCourseSurfaces
area_9 = Surface.Area(surface=createBaseCourseSurfaces.Surface)
code_block_144 = CodeBlock(i=area_9) { Math.Round(List.Flatten(i)/1000000, 2); }
code_block_145 = CodeBlock { "M2"; }
count_13 = List.Count(list=code_block_144)
ofRepeatedItem_9 = List.OfRepeatedItem(item=code_block_145, amount=count_13)
code_block_146 = CodeBlock(FuncValues=code_block_144, FuncValuesUnit=ofRepeatedItem_9)  # same code as code_block_101
code_block_147 = CodeBlock { 300; 100; }

# group: Output Manager
output_9 = CodeBlock(MainOutput=code_block_146) { MainOutput; RefOutput_geoColor; }  # unwired: RefOutput_geoColor
reference_output_9 = CodeBlock(ref=createBaseCourseSurfaces.Surface) { ref; }

# group: Input Manager
value_for_import_from_others_12 = CodeBlock(MainInput=code_block_96, RefInput1=reference_output_9) { MainInput; RefInput1; RefInput2; }  # unwired: RefInput2

# group: <Func 8>Crushed Stone
code_block_148 = CodeBlock { "TargetElements"; }
valueAtKey_11 = DesignScript.Builtin.Dictionary.ValueAtKey(dictionary=value_for_import_from_others_12.MainInput, key=code_block_148)
createBaseCourseSurfaces_2 = Custom[CreateBaseCourseSurfaces](Element=valueAtKey_11)
# note: <Func>
code_block_149 = CodeBlock { 300; 100; }
boolean_3 = BoolSelector(false)
thicken = Surface.Thicken(surface=createBaseCourseSurfaces_2.Surface, thickness=code_block_149.out0, both_sides=boolean_3)
volume_8 = Solid.Volume(solid=thicken)
code_block_150 = CodeBlock(i=volume_8) { Math.Round(List.Flatten(i)/1000000000, 2); }
code_block_151 = CodeBlock { "M3"; }
count_14 = List.Count(list=code_block_150)
ofRepeatedItem_10 = List.OfRepeatedItem(item=code_block_151, amount=count_14)
code_block_152 = CodeBlock(FuncValues=code_block_150, FuncValuesUnit=ofRepeatedItem_10)  # same code as code_block_101

# group: Output Manager
reference_output_10 = CodeBlock { ref; }  # unwired: ref
output_10 = CodeBlock(MainOutput=code_block_152) { MainOutput; RefOutput_geoColor; }  # unwired: RefOutput_geoColor

# group: Input Manager
value_for_import_from_others_13 = CodeBlock(MainInput=code_block_96) { MainInput; RefInput1; RefInput2; }  # unwired: RefInput1, RefInput2

# group: <Func 10>Rebar Work
code_block_153 = CodeBlock { "TargetElements"; }
valueAtKey_12 = DesignScript.Builtin.Dictionary.ValueAtKey(dictionary=value_for_import_from_others_13.MainInput, key=code_block_153)
code_block_154 = CodeBlock { "Volume"; }
# note: <Func>
getParameterValueByName_12 = Element.GetParameterValueByName(element=valueAtKey_12, parameterName=code_block_154)
sog_철근비 = DoubleInput(0)  # graph input
mul = getParameterValueByName_12 * sog_철근비
code_block_155 = CodeBlock(i=mul) { Math.Round(List.Flatten(i)/1, 2); }
code_block_156 = CodeBlock { "TON"; }
count_15 = List.Count(list=code_block_155)
ofRepeatedItem_11 = List.OfRepeatedItem(item=code_block_156, amount=count_15)
code_block_157 = CodeBlock(FuncValues=code_block_155, FuncValuesUnit=ofRepeatedItem_11)  # same code as code_block_101

# group: Output Manager
reference_output_11 = CodeBlock { ref; }  # unwired: ref
output_11 = CodeBlock(MainOutput=code_block_157) { MainOutput; RefOutput_geoColor; }  # unwired: RefOutput_geoColor

join_11 = List.Join(list0=output_3.MainOutput, list1=output_5.MainOutput, list2=output_6.MainOutput, list3=output_7.MainOutput, list4=output_2.MainOutput, list5=output_8.MainOutput, list6=output_4.MainOutput, list7=output_9.MainOutput, list8=output_10.MainOutput, list9=output.MainOutput, list10=output_11.MainOutput)

# group: TargetWMunique + Data Sending
code_block_158 = CodeBlock(InputDic2=join_11) { _InputDic2; }
count_16 = List.Count(list=code_block_158)
code_block_159 = CodeBlock(InputDic1=selectTargetFamilyInformAsDictionary) { _InputDic1; }
code_block_160 = CodeBlock { "TargetWMunique"; }
valueAtKey_13 = DesignScript.Builtin.Dictionary.ValueAtKey(dictionary=code_block_159, key=code_block_160)
watch_23 = Watch(valueAtKey_13)
count_17 = List.Count(list=watch_23)
eq = count_16 == count_17
organizeFuncValuesAndWorkMasterAsDiction = Custom[OrganizeFuncValuesAndWorkMasterAsDictionary](InputDic1=code_block_159, InputDic2=code_block_158)  # Organize FuncValues and WorkMaster As Dictionary
watch_24 = Watch()  # unwired: arg0
if_3 = If(test=eq, true=organizeFuncValuesAndWorkMasterAsDiction, false=watch_24)

# group: 하위분개
keys = DesignScript.Builtin.Dictionary.Keys(dictionary=selectTargetFamilyInformAsDictionary)
code_block_161 = CodeBlock(i=keys) { i; }
valueAtKey_14 = DesignScript.Builtin.Dictionary.ValueAtKey(dictionary=selectTargetFamilyInformAsDictionary, key=keys)
code_block_162 = CodeBlock { -1; }
dropItems = List.DropItems(list=valueAtKey_14, amount=code_block_162)
code_block_163 = CodeBlock { 0; }
code_block_164 = CodeBlock(i=dropItems) { i[0]; i[1]; i[2]; }
flatten_19 = List.Flatten(list=code_block_164.out0)
replaceItemAtIndex = List.ReplaceItemAtIndex(list=dropItems, index=code_block_163, item=flatten_19)
code_block_165 = CodeBlock { 1; }
flatten_20 = List.Flatten(list=code_block_164.out1@L2)
replaceItemAtIndex_2 = List.ReplaceItemAtIndex(list=replaceItemAtIndex, index=code_block_165, item=flatten_20)
code_block_166 = CodeBlock { 2; }
flatten_21 = List.Flatten(list=code_block_164.out2)
replaceItemAtIndex_3 = List.ReplaceItemAtIndex(list=replaceItemAtIndex_2, index=code_block_166, item=flatten_21)
분개_index_입력 = CodeBlock { [0,4]; }
getItemAtIndex_8 = List.GetItemAtIndex(list=replaceItemAtIndex_3@L3, index=분개_index_입력)
code_block_167 = CodeBlock(i=getItemAtIndex_8) { i[1]; }
flatten_22 = List.Flatten(list=code_block_167)
uniqueItems_4 = List.UniqueItems(list=flatten_22)
addItemToEnd = List.AddItemToEnd(item=uniqueItems_4, list=getItemAtIndex_8)
byKeysValues = DesignScript.Builtin.Dictionary.ByKeysValues(keys=code_block_161, values=addItemToEnd)

watch_25 = Watch(output_2.MainOutput)
code_block_168 = CodeBlock(i=selectTargetFamilyInformAsDictionary) { i; }

# group: Input Manager
value_for_import_from_others_14 = CodeBlock(MainInput=code_block_168) { MainInput; RefInput1; RefInput2; }  # unwired: RefInput1, RefInput2

code_block_169 = CodeBlock { "TargetElements"; }
# note: <Func>
valueAtKey_15 = DesignScript.Builtin.Dictionary.ValueAtKey(dictionary=value_for_import_from_others_14.MainInput, key=code_block_169)
flatten_23 = List.Flatten(list=valueAtKey_15)
# note: 일반화 여지가 있음
# (형상처리구간 + 물량계산 + 데이터 매칭)
extractUpperFacesOfElement_2 = Custom[ExtractUpperFacesOfElement](Element=flatten_23)
area_10 = Surface.Area(surface=extractUpperFacesOfElement_2.Surface)
sum_2 = Math.Sum(values=area_10)
code_block_170 = CodeBlock(i=sum_2) { Math.Round(List.Flatten(i)/1000000, 2); }
code_block_171 = CodeBlock { "M2"; }
count_18 = List.Count(list=code_block_170)
ofRepeatedItem_12 = List.OfRepeatedItem(item=code_block_171, amount=count_18)
code_block_172 = CodeBlock(FuncValues=code_block_170, FuncValuesUnit=ofRepeatedItem_12)  # same code as code_block_101
color_palette_3 = ColorPalette({R: 30, G: 144, B: 255, A: 129})
byGeometryColor_3 = Modifiers.GeometryColor.ByGeometryColor(geometry=extractUpperFacesOfElement_2.Surface, color=color_palette_3)

# group: Output Manager
output_12 = CodeBlock(MainOutput=code_block_172, RefOutput_geoColor=byGeometryColor_3) { MainOutput; RefOutput_geoColor; }
reference_output_12 = CodeBlock { ref; }  # unwired: ref

# group: <Func 6> Visual Manager
visual_켜기_끄기_4 = BoolSelector(false)
visual_manager_4 = Python(IN[0]=output_12.RefOutput_geoColor, IN[1]=visual_켜기_끄기_4)  # CPython3; same code as visual_manager

categories_3 = Categories("OST_Ceilings")
all_elements_of_category_3 = ElementsOfCategory(Category=categories_3)
extractBelowFacesOfElement = Custom[ExtractBelowFacesOfElement](Element=all_elements_of_category_3)  # ExtractBelowFacesOfElement
perimeterCurves_4 = Surface.PerimeterCurves(surface=extractBelowFacesOfElement.Surface)
byJoinedCurves_2 = PolyCurve.ByJoinedCurves(curves=perimeterCurves_4)
flatten_24 = List.Flatten(list=byJoinedCurves_2)
code_block_173 = CodeBlock { 0.5; }
pointAtParameter = Surface.PointAtParameter(surface=extractBelowFacesOfElement.Surface, u=code_block_173, v=code_block_173)
Z_6 = Point.Z(point=pointAtParameter)
code_block_174 = CodeBlock(A=Z_6) { -A; }
translate_2 = Geometry.Translate(geometry=extractBelowFacesOfElement.Surface, zTranslation=code_block_174)
perimeterCurves_5 = Surface.PerimeterCurves(surface=translate_2)
byJoinedCurves_3 = PolyCurve.ByJoinedCurves(curves=perimeterCurves_5)
flatten_25 = List.Flatten(list=byJoinedCurves_3)
list_create_2 = List.Create(item0=flatten_24, item1=flatten_25)
transpose_11 = List.Transpose(lists=list_create_2)
byLoft_2 = Solid.ByLoft(crossSections=transpose_11)
byUnion = Solid.ByUnion(solids=byLoft_2)
geometry_7 = Element.Geometry(element=valueAtKey_15)
explode_3 = Geometry.Explode(geometry=geometry_7)
byJoinedSurfaces = PolySurface.ByJoinedSurfaces(surfaces=explode_3)
flatten_26 = List.Flatten(list=byJoinedSurfaces)
categories_4 = Categories("OST_Walls")
all_elements_of_category_4 = ElementsOfCategory(Category=categories_4)
geometry_8 = Element.Geometry(element=all_elements_of_category_4)
explode_4 = Geometry.Explode(geometry=geometry_8)
flatten_27 = List.Flatten(list=explode_4)
byJoinedSurfaces_2 = PolySurface.ByJoinedSurfaces(surfaces=flatten_27)
difference = Surface.Difference(surface=flatten_26, others=byJoinedSurfaces_2, lacing=CrossProduct)
intersect = Geometry.Intersect(geometry=byUnion, other=difference)
categories_5 = Categories("OST_Rooms")
all_elements_of_category_5 = ElementsOfCategory(Category=categories_5)
code_block_175 = CodeBlock { "Wall Finish"; }
getParameterValueByName_13 = Element.GetParameterValueByName(element=all_elements_of_category_5, parameterName=code_block_175)
coreBoundary = Room.CoreBoundary(room=all_elements_of_category_5)
byGeometry_2 = BoundingBox.ByGeometry(geom=coreBoundary)
toCuboid_2 = BoundingBox.ToCuboid(boundingBox=byGeometry_2)
byJoinedCurves_4 = PolyCurve.ByJoinedCurves(curves=coreBoundary@L2)
code_block_176 = CodeBlock(A=Z_6) { A; }
translate_3 = Geometry.Translate(geometry=byJoinedCurves_4, zTranslation=code_block_176)
categories_6 = Categories("OST_StructuralFoundation")
all_elements_of_category_6 = ElementsOfCategory(Category=categories_6)
parameters_2 = Element.Parameters(element=all_elements_of_category_6)
code_block_177 = CodeBlock { "Type"; }
getParameterValueByName_14 = Element.GetParameterValueByName(element=all_elements_of_category_6, parameterName=code_block_177)
string_from_object_14 = FromObject(object=getParameterValueByName_14)
code_block_178 = CodeBlock { "FT111"; }
contains_2 = String.Contains(str=string_from_object_14, searchFor=code_block_178)
filterByBoolMask_10 = List.FilterByBoolMask(list=all_elements_of_category_6, mask=contains_2)
code_block_179 = CodeBlock { "Type"; }
getParameterValueByName_15 = Element.GetParameterValueByName(element=filterByBoolMask_10.in, parameterName=code_block_179)
string_from_object_15 = FromObject(object=getParameterValueByName_15)
code_block_180 = CodeBlock { "PATHWAY"; }
contains_3 = String.Contains(str=string_from_object_15, searchFor=code_block_180)
filterByBoolMask_11 = List.FilterByBoolMask(list=filterByBoolMask_10.in, mask=contains_3)
geometry_9 = Element.Geometry(element=filterByBoolMask_11.out)
flatten_28 = List.Flatten(list=geometry_9)
byGeometry_3 = BoundingBox.ByGeometry(geom=flatten_28)
toCuboid_3 = BoundingBox.ToCuboid(boundingBox=byGeometry_3)

# group: func2
code_block_181 = CodeBlock(Element=toCuboid_3) { _Element: var[]..[]; }
code_block_182 = CodeBlock(Element=code_block_181) { _Element; }
explode_5 = Geometry.Explode(geometry=code_block_182)
explode_6 = Geometry.Explode()  # unwired: geometry
code_block_183 = CodeBlock { 0.5; }
normalAtParameter_6 = Surface.NormalAtParameter(u=code_block_183, v=code_block_183)  # unwired: surface
function_compose = ComposeFunctions(function0=explode_6, function1=normalAtParameter_6)
function_apply = ApplyFunction(function=function_compose, argument0=code_block_182)
Z_7 = Vector.Z(vector=function_apply)
code_block_184 = CodeBlock { 0; }
round_2 = Math.Round(number=Z_7, digits=code_block_184)
code_block_185 = CodeBlock(i=round_2) { i==1; }
filterByBoolMask_12 = List.FilterByBoolMask(list=explode_5, mask=code_block_185)
color_palette_4 = ColorPalette({R: 238, G: 232, B: 170, A: 128})
byGeometryColor_4 = Modifiers.GeometryColor.ByGeometryColor(geometry=filterByBoolMask_12.in, color=color_palette_4)

pointAtParameter_2 = Surface.PointAtParameter(surface=filterByBoolMask_12.in)
python_script_3 = Python()  # CPython3; unwired: IN[0]
# ---------- python_script_3.python (129 lines) ----------
# Load the Python Standard and DesignScript Libraries
import os
import sys
sys.path.append(os.getenv('LOCALAPPDATA').replace('\\','\\\\') + r'\Programs\Python\Python39\Lib\site-packages')
import clr
clr.AddReference('RevitAPI')
import Autodesk

clr.AddReference('ProtoGeometry')
from Autodesk.DesignScript.Geometry import *

clr.AddReference('RevitNodes')
import Revit
clr.ImportExtensions(Revit.Elements)

clr.ImportExtensions(Revit.GeometryConversion)
clr.ImportExtensions(Revit.GeometryReferences)

clr.AddReference('RevitServices')
import RevitServices
from RevitServices.Persistence import DocumentManager
from RevitServices.Transactions import TransactionManager

doc = DocumentManager.Instance.CurrentDBDocument

import random
import itertools
from functools import reduce

# The inputs to this node will be stored as a list in the IN variables.
dataEnteringNode = IN

# Place your code below this line
class ConvexHull_Maker:
    def __init__(self, points):
        def convex_hull_graham(points):
            def ToVals(pt):
	            return [pt.X,pt.Y,pt.Z]
            def ToPts(ptVals):
	            return Point.ByCoordinates(ptVals[0],ptVals[1],ptVals[2])
	           
            def CreateOutline(pts):
                crvs = []
                i = 0
                while i < len(pts):
                    if i == len(pts)-1:
                        crvs.append(Line.ByStartPointEndPoint(pts[i],pts[0]))
                    else:
                        crvs.append(Line.ByStartPointEndPoint(pts[i],pts[i+1]))
                    i = i+1
                return PolyCurve.ByJoinedCurves(crvs)
	
            TURN_LEFT, TURN_RIGHT, TURN_NONE = (1, -1, 0)

            def cmp(a, b):
                return (a > b) - (a < b)
	
            def turn(p, q, r):
                return cmp((q[0] - p[0])*(r[1] - p[1]) - (r[0] - p[0])*(q[1] - p[1]), 0)
	
            def _keep_left(hull, r):
                while len(hull) > 1 and turn(hull[-2], hull[-1], r) != TURN_LEFT:
                    hull.pop()
                if not len(hull) or hull[-1] != r:
                    hull.append(r)
                return hull

            points = [ToVals(p) for p in points]	
            points = sorted(points)
            l = reduce(_keep_left, points, [])
            u = reduce(_keep_left, reversed(points), [])
            points = l.extend(u[i] for i in range(1, len(u) - 1)) or l
            points = [ToPts(p) for p in points]
            return CreateOutline(points)
            
        self.points = points
        result = convex_hull_graham(points)
        self.result = result

def repeatFuncApply(func, repeat, data_input):
    result = []
    input_forFunc = data_input
    while repeat != 0:
        result.append(func(input_forFunc))
        input_forFunc = func(input_forFunc)
        repeat = repeat - 1
    return result

def create_horizonLine(endpt):
    sttpt = Point.ByCoordinates(0,0,0)
    line_prime = Line.ByStartPointEndPoint(sttpt, endpt)
    return line_prime
    
def create_verticalLine(endpt):
    sttpt = Point.ByCoordinates(0,0,0)
    line_prime = Line.ByStartPointEndPoint(sttpt, endpt)
    return line_prime
    
def curveOffset(elem, dist):
    result = Curve.Offset(elem, dist)
    return result
    
def range_q(start, end, num):
    result = [start]
    between = num - 1
    gap = end - start
    step = gap / between
    for i in range(num):
        if i == 0:
            pass
        else:
            target = start + step * i
            result.append(target)
    return result



##########################################################
result = [
ConvexHull_Maker,
repeatFuncApply,
create_horizonLine,
create_verticalLine,
curveOffset,
range_q
]	

# Assign your output to the OUT variable.
OUT = result
# ----------------------------------------
getParameterValueByName_16 = Element.GetParameterValueByName()  # unwired: element, parameterName
string_from_object_16 = FromObject()  # unwired: object
python_script_4 = Python()  # CPython3; unwired: IN[0]
# ---------- python_script_4.python (65 lines) ----------
# Load the Python Standard and DesignScript Libraries
import os
import sys
sys.path.append(os.getenv('LOCALAPPDATA').replace('\\','\\\\') + r'\Programs\Python\Python39\Lib\site-packages')
import clr
clr.AddReference('RevitAPI')
from Autodesk.Revit.DB import *

clr.AddReference('ProtoGeometry')
from Autodesk.DesignScript.Geometry import *

clr.AddReference('RevitNodes')
import Revit
clr.ImportExtensions(Revit.Elements)

clr.ImportExtensions(Revit.GeometryConversion)
clr.ImportExtensions(Revit.GeometryReferences)

clr.AddReference('RevitServices')
import RevitServices
from RevitServices.Persistence import DocumentManager
from RevitServices.Transactions import TransactionManager

doc = DocumentManager.Instance.CurrentDBDocument
uiapp = DocumentManager.Instance.CurrentUIApplication
app = uiapp.Application

import random
import itertools
from functools import reduce

# The inputs to this node will be stored as a list in the IN variables.
dataEnteringNode = IN

def getParam(element,param):
	value = []
	try:
		DB = element.GetParameters(param)
		for i in DB:
			if "Double" in str(i.StorageType): 
				# Metric Converstion
				value.append(i.AsDouble()*304.8)
			elif "Integer" in str(i.StorageType):
				value.append(i.AsInteger())
			elif "String" in str(i.StorageType):
				value.append(i.AsString())
			else:
				elemId =i.AsElementId()
				value.append(doc.GetElement(elemId))
	except:
		pass
	return value

# Place your code below this line

allStrFdn = list(FilteredElementCollector(doc).OfCategory(BuiltInCategory.OST_StructuralFoundation).WhereElementIsNotElementType())#.ToElements()
typeOfStrFdn = getParam(allStrFdn[0], "Type")

#a = list(filter(lambda x: getParam(x, "Type"), allStrFdn))

##########################################################


# Assign your output to the OUT variable.
OUT = typeOfStrFdn[0].Name
# ----------------------------------------
name_2 = Element.Name(element=python_script_4)
