# Dynamo graph 02 Stairs (1118).dyn (Dynamo 2.10.1.3976)

# group: Sample
code_block = CodeBlock {  }
code_block_2 = CodeBlock {  }

# group: Primary Input
categories = Categories("OST_StructuralFoundation")
all_elements_of_category = ElementsOfCategory(Category=categories)
file_path = Filename("..\BIM_물량집계 자동화 산출기준표_rC(20211029).xlsx")
file_from_path = FileObject(path=file_path)
code_block_3 = CodeBlock { "Str Foundations"; }

# group: GetFull WMCodeDescription PerElement
code_block_4 = CodeBlock(InputElement=all_elements_of_category, InputFilePath=file_from_path, InputSheetName=code_block_3) { _InputElement; _InputFilePath; _InputSheetName; }
excelDataManagerNode = Python(IN[0]=code_block_4._InputElement, IN[1]=code_block_4._InputFilePath, IN[2]=code_block_4._InputSheetName)  # CPython3
# ---------- excelDataManagerNode.python (279 lines) ----------
# Load the Python Standard and DesignScript Libraries
import os
import sys
sys.path.append(os.getenv('LOCALAPPDATA').replace('\\','\\\\') + r'\Programs\Python\Python39\Lib\site-packages')
import clr
clr.AddReference('RevitAPI')
import Autodesk

clr.AddReference('ProtoGeometry')
from Autodesk.DesignScript.Geometry import *

clr.AddReference('RevitNodes')
import Revit
clr.ImportExtensions(Revit.Elements)

clr.ImportExtensions(Revit.GeometryConversion)
clr.ImportExtensions(Revit.GeometryReferences)

clr.AddReference('RevitServices')
import RevitServices
from RevitServices.Persistence import DocumentManager
from RevitServices.Transactions import TransactionManager

doc = DocumentManager.Instance.CurrentDBDocument

import random
import itertools
from functools import reduce
from collections import Iterable
import datetime
import openpyxl

def iterable(obj):
    return isinstance(obj, Iterable)

def findUnique(inputs):
    result = []
    for i in inputs:
        if i in result:
            pass
        else:
            result.append(i)
    return result

# The inputs to this node will be stored as a list in the IN variables.
dataEnteringNode = IN
inputElements = IN[0]
inputFilePath = IN[1]
inputSheetName = IN[2]

def importExcel(path, SheetNameIn):
    wb_obj = openpyxl.load_workbook(str(path), data_only=True)
    sheet_obj = wb_obj.get_sheet_by_name(str(SheetNameIn))

    m_row = sheet_obj.max_row
    m_col = sheet_obj.max_column

    listOut = []

    for i in range(1, m_row +1):
        listTemp = []
        for j in range(1, m_col + 1):
            cell_obj = sheet_obj.cell(row=i, column=j)
            listTemp.append(cell_obj.value)
            if len(listTemp) == m_col:
                listOut.append(listTemp)
    return listOut

def getUsedFamilyTypeOfModeling(elements):
    familyCode = list(map(lambda x: x.Name.split('_')[0], elements))
    unq_familyCode = findUnique(familyCode)
    return unq_familyCode
    
def createExcelDataDictionary(values):
    result = {}
    for i in range(len(values)):
        result[str(i)] = values[i]
    return result

def findTargetIndex(targets, list):
    result = []
    for target in targets:
        for i in range(len(list)):
            if target in str(list[i]):
                result.append(i)
            else:
                pass
    result.sort()
    return result
    
def GetValueAtKeys(keys, dictionary):
    result = [] 
    for i in keys:
        result.append(dictionary[str(i)])
    return result


# Place your code below this line
usedFamilyTypeOfModeling = getUsedFamilyTypeOfModeling(inputElements)
excelWholeDataSet = importExcel(inputFilePath, inputSheetName)
trExcelWholeDataSet = list(zip(*excelWholeDataSet))
excelColumnDataSet = createExcelDataDictionary(trExcelWholeDataSet)
excelRowDataSet = createExcelDataDictionary(excelWholeDataSet)
ColumnIndexOfUsedFamilyType = findTargetIndex(usedFamilyTypeOfModeling, trExcelWholeDataSet)
ColDataSetOfUsedFamilyType = GetValueAtKeys(ColumnIndexOfUsedFamilyType, excelColumnDataSet)
materialPerElementFromModeling = []
for i in inputElements:
    materialPerElementFromModeling.append(i.GetMaterials())
#list(map(lambda x: x.GetMaterials, inputElements)) "맵함수로 처리하면 리스트화 할 때 타입 변환 오류 남"

targetWMRowIndex = []
for i in ColDataSetOfUsedFamilyType:
    targetWMRowIndex.append(findTargetIndex(['000'], i))

rowDataSetOfUsedWM = []
for i in targetWMRowIndex:
    rowDataSetOfUsedWM.append(GetValueAtKeys(i, excelRowDataSet))

workGroup = []
for i in rowDataSetOfUsedWM:
    tmp = []
    for j in i:
        tmp.append(j[0])
    workGroup.append(tmp)
    
workMaster = []
for i in range(len(ColDataSetOfUsedFamilyType)):
    tmp=[]
    for k in targetWMRowIndex[i]:
        tmp.append(ColDataSetOfUsedFamilyType[i][k])
    workMaster.append(tmp)

matchedWM = []
for i in range(len(workGroup)):
    tmp = []
    for j in range(len(workGroup[i])):
        fullWM = workGroup[i][j] +"-"+ workMaster[i][j]
        tmp.append(fullWM)
    matchedWM.append(tmp)

matchedWorkGruopAndMasterCode = []
for i in matchedWM:
    if len(i) > 0:
        matchedWorkGruopAndMasterCode.append(i)
    else:
        pass

matchedWMDescription = []
for i in rowDataSetOfUsedWM:
    tmp=[]
    for j in i:
        tmp.append(j[1] +" "+ j[2] +" "+ j[3] +" "+ "("+ j[4] +")")
    if len(tmp) > 0:
        matchedWMDescription.append(tmp)
    else:
        pass

matchedWMUnit = []
for i in rowDataSetOfUsedWM:
    tmp=[]
    for j in i:
        tmp.append(j[4])
    if len(tmp) > 0:
        matchedWMUnit.append(tmp)
    else:
        pass

matchedWorkGruopAndMasterCode_flat = list(itertools.chain(*matchedWorkGruopAndMasterCode))
matchedWMDescription_flat = list(itertools.chain(*matchedWMDescription))

dic_WMandDescription_Excel = {}
for i in range(len(matchedWorkGruopAndMasterCode_flat)):
    dic_WMandDescription_Excel[matchedWorkGruopAndMasterCode_flat[i]] = matchedWMDescription_flat[i]

usedFamilyTypeInExcelOrder = list(map(lambda x: x[3], ColDataSetOfUsedFamilyType))
usedFamilyCodeInExcelOrder = findUnique(list(map(lambda x: x.split('_')[0], usedFamilyTypeInExcelOrder)))

dic_FamilyCodeandWM = {}
for i in range(len(usedFamilyCodeInExcelOrder)):
    dic_FamilyCodeandWM[usedFamilyCodeInExcelOrder[i]] = matchedWorkGruopAndMasterCode[i]

workMasterCodePerElement = []
familyCodePerElem = list(map(lambda x: x.Name.split('_')[0], inputElements))
for i in familyCodePerElem:
    workMasterCodePerElement.append(dic_FamilyCodeandWM[i])

materialNamePerElem = []
for i in materialPerElementFromModeling:
    tmp = []
    for j in i:
        tmp.append(j.Name)
    materialNamePerElem.append(tmp)

WMPerElementFromModeling = []
for i in materialNamePerElem:
    tmp = []
    for j in i:
        tmp.append(j.split('_')[0])
    WMPerElementFromModeling.append(tmp)

specPerElementFromModeling = []
for i in materialNamePerElem:
    tmp = []
    for j in i:
        a = j.split('_')
        del a[0]
        b = " ".join(a)
        tmp.append(b)
    specPerElementFromModeling.append(tmp)

WMPerElementFromModeling_flat = list(itertools.chain(*WMPerElementFromModeling))
specPerElementFromModeling_flat = list(itertools.chain(*specPerElementFromModeling))

dic_WMandDescription_Model = {}
for i in range(len(WMPerElementFromModeling_flat)):
    dic_WMandDescription_Model[WMPerElementFromModeling_flat[i]] = specPerElementFromModeling_flat[i]

def findAllKeys(dict):
    result = []
    for key in dict.keys():
        result.append(key)
    return result

def findAllValues(dict):
    result = []
    for key in dict.keys():
        result.append(dict[key])
    return result

keys_WMandDescription_Model = findAllKeys(dic_WMandDescription_Model)
keys_WMandDescription_Excel = findAllKeys(dic_WMandDescription_Excel)

keys_WMandDescription_Both = list(set(keys_WMandDescription_Model + keys_WMandDescription_Excel))
values_WMandDescription_Both = []
for i in keys_WMandDescription_Both:
    if i in keys_WMandDescription_Model:
        values_WMandDescription_Both.append(dic_WMandDescription_Model[i])
    else:
        values_WMandDescription_Both.append(dic_WMandDescription_Excel[i])

dic_WMandDescription_Both = {}
for i in range(len(keys_WMandDescription_Both)):
    dic_WMandDescription_Both[keys_WMandDescription_Both[i]] = values_WMandDescription_Both[i]

workMasterCodePerElementFromBoth = []
for i in range(len(workMasterCodePerElement)):
    #tmp = []
    a = WMPerElementFromModeling[i] + workMasterCodePerElement[i]
    b = findUnique(a)
    workMasterCodePerElementFromBoth.append(b)

specPerElement = []
for i in workMasterCodePerElementFromBoth:
    tmp = []
    for j in i:
        tmp.append(dic_WMandDescription_Both[j])
    specPerElement.append(tmp)

fullWMCodeDescriptionPerElement = []
for i in range(len(workMasterCodePerElementFromBoth)):
    tmp = []
    for j in range(len(workMasterCodePerElementFromBoth[i])):
        a = workMasterCodePerElementFromBoth[i][j] +": "+ specPerElement[i][j]
        tmp.append(a)
    fullWMCodeDescriptionPerElement.append(tmp)

fullWMinfo = {
"AllElement": inputElements,
"WorkMasterCodePerFamilyType": dic_FamilyCodeandWM,
"WorkMasterCodePerElementBoth": workMasterCodePerElementFromBoth,
"FullWMCodeDescriptionPerElement": fullWMCodeDescriptionPerElement
}



result = fullWMinfo

# Assign your output to the OUT variable.
OUT = result
# ----------------------------------------

# group: Organize AllElementInform AsDictionary
set_up_all_element_inform_as = Python(IN[0]=excelDataManagerNode)  # "Set Up All Element Inform as Dictionary"; CPython3
# ---------- set_up_all_element_inform_as.python (119 lines) ----------
# Load the Python Standard and DesignScript Libraries
import os
import sys
sys.path.append(os.getenv('LOCALAPPDATA').replace('\\','\\\\') + r'\Programs\Python\Python39\Lib\site-packages')
import clr
clr.AddReference('RevitAPI')
import Autodesk

clr.AddReference('ProtoGeometry')
from Autodesk.DesignScript.Geometry import *

clr.AddReference('RevitNodes')
import Revit
clr.ImportExtensions(Revit.Elements)

clr.ImportExtensions(Revit.GeometryConversion)
clr.ImportExtensions(Revit.GeometryReferences)

clr.AddReference('RevitServices')
import RevitServices
from RevitServices.Persistence import DocumentManager
from RevitServices.Transactions import TransactionManager

doc = DocumentManager.Instance.CurrentDBDocument

import random
import itertools
from functools import reduce
from collections import Iterable
import datetime
import openpyxl

def iterable(obj):
    return isinstance(obj, Iterable)

def findUnique(inputs):
    result = []
    for i in inputs:
        if i in result:
            pass
        else:
            result.append(i)
    return result

# The inputs to this node will be stored as a list in the IN variables.
dataEnteringNode = IN
inputDict = IN[0]


def importExcel(path, SheetNameIn):
    wb_obj = openpyxl.load_workbook(str(path), data_only=True)
    sheet_obj = wb_obj.get_sheet_by_name(str(SheetNameIn))

    m_row = sheet_obj.max_row
    m_col = sheet_obj.max_column

    listOut = []

    for i in range(1, m_row +1):
        listTemp = []
        for j in range(1, m_col + 1):
            cell_obj = sheet_obj.cell(row=i, column=j)
            listTemp.append(cell_obj.value)
            if len(listTemp) == m_col:
                listOut.append(listTemp)
    return listOut

def getUsedFamilyTypeOfModeling(elements):
    familyCode = list(map(lambda x: x.Name.split('_')[0], elements))
    unq_familyCode = findUnique(familyCode)
    return unq_familyCode
    
def createExcelDataDictionary(values):
    result = {}
    for i in range(len(values)):
        result[str(i)] = values[i]
    return result

def findTargetIndex(targets, list):
    result = []
    for target in targets:
        for i in range(len(list)):
            if target in str(list[i]):
                result.append(i)
            else:
                pass
    result.sort()
    return result
    
def GetValueAtKeys(keys, dictionary):
    result = [] 
    for i in keys:
        result.append(dictionary[str(i)])
    return result


# Place your code below this line
element = inputDict["AllElement"]
elementType = []
for i in element:
    elementType.append(i.Name)
familyCode = []
for i in elementType:
    familyCode.append(i.split("_")[0])
fullWMCodeDescriptionPerElement = inputDict["FullWMCodeDescriptionPerElement"]

resultDict = {
"Element": element,
"ElementType": elementType,
"FamilyCode": familyCode,
"FullWMCodeDescriptionPerElement": fullWMCodeDescriptionPerElement
}



result = resultDict

# Assign your output to the OUT variable.
OUT = result
# ----------------------------------------

# group: Select Target Family Element And Connected WorkMasters
code_block_5 = CodeBlock { 1; }
select_target_family_element_and = Python(IN[0]=set_up_all_element_inform_as, IN[1]=code_block_5)  # "Select Target Family Element And Connected WorkMasters"; CPython3
# ---------- select_target_family_element_and.python (138 lines) ----------
# Load the Python Standard and DesignScript Libraries
import os
import sys
sys.path.append(os.getenv('LOCALAPPDATA').replace('\\','\\\\') + r'\Programs\Python\Python39\Lib\site-packages')
import clr
clr.AddReference('RevitAPI')
import Autodesk

clr.AddReference('ProtoGeometry')
from Autodesk.DesignScript.Geometry import *

clr.AddReference('RevitNodes')
import Revit
clr.ImportExtensions(Revit.Elements)

clr.ImportExtensions(Revit.GeometryConversion)
clr.ImportExtensions(Revit.GeometryReferences)

clr.AddReference('RevitServices')
import RevitServices
from RevitServices.Persistence import DocumentManager
from RevitServices.Transactions import TransactionManager

doc = DocumentManager.Instance.CurrentDBDocument

import random
import itertools
from functools import reduce
from collections import Iterable
import datetime
import openpyxl

def iterable(obj):
    return isinstance(obj, Iterable)

def findUnique(inputs):
    result = []
    for i in inputs:
        if i in result:
            pass
        else:
            result.append(i)
    return result

# The inputs to this node will be stored as a list in the IN variables.
dataEnteringNode = IN
inputDict = IN[0]
inputIndex = IN[1]


def importExcel(path, SheetNameIn):
    wb_obj = openpyxl.load_workbook(str(path), data_only=True)
    sheet_obj = wb_obj.get_sheet_by_name(str(SheetNameIn))

    m_row = sheet_obj.max_row
    m_col = sheet_obj.max_column

    listOut = []

    for i in range(1, m_row +1):
        listTemp = []
        for j in range(1, m_col + 1):
            cell_obj = sheet_obj.cell(row=i, column=j)
            listTemp.append(cell_obj.value)
            if len(listTemp) == m_col:
                listOut.append(listTemp)
    return listOut

def getUsedFamilyTypeOfModeling(elements):
    familyCode = list(map(lambda x: x.Name.split('_')[0], elements))
    unq_familyCode = findUnique(familyCode)
    return unq_familyCode
    
def createExcelDataDictionary(values):
    result = {}
    for i in range(len(values)):
        result[str(i)] = values[i]
    return result

def findTargetIndex(targets, list):
    result = []
    for target in targets:
        for i in range(len(list)):
            if target in str(list[i]):
                result.append(i)
            else:
                pass
    result.sort()
    return result
    
def GetValueAtKeys(keys, dictionary):
    result = [] 
    for i in keys:
        result.append(dictionary[str(i)])
    return result


# Place your code below this line
fullWMCodeDescriptionPerElement = inputDict["FullWMCodeDescriptionPerElement"]
element = inputDict["Element"]
familyCode = inputDict["FamilyCode"]
familyCode_unique = findUnique(familyCode)
targetFamilyCode = familyCode_unique[inputIndex]
targetIndex = []
for i in range(len(familyCode)):
    if targetFamilyCode in familyCode[i]:
        targetIndex.append(i)
    else:
        pass

targetElements = []
for i in targetIndex:
    targetElements.append(element[i])

targetFamilyCode = []
for i in targetIndex:
    targetFamilyCode.append(element[i].Name)

WMforTargetElements = []
for i in targetIndex:
    WMforTargetElements.append(fullWMCodeDescriptionPerElement[i])

WMforTargetElements_flat = list(itertools.chain(*WMforTargetElements))
targetWMunique = findUnique(WMforTargetElements_flat)

resultDict = {
"TargetElements": targetElements,
"TargetFamilyCode": targetFamilyCode,
"WMforTargetElements": WMforTargetElements,
"TargetWMunique": targetWMunique
}



result = resultDict

# Assign your output to the OUT variable.
OUT = result
# ----------------------------------------

watch = Watch(select_target_family_element_and)
code_block_6 = CodeBlock(i=watch) { i; }

# group: Input Manager
value_for_import_from_others = CodeBlock(MainInput=code_block_6) { MainInput; RefInput1; RefInput2; }  # unwired: RefInput1, RefInput2

# group: <Func 9>Lean Concrete
code_block_7 = CodeBlock { "TargetElements"; }
valueAtKey = DesignScript.Builtin.Dictionary.ValueAtKey(dictionary=value_for_import_from_others.MainInput, key=code_block_7)
code_block_8 = CodeBlock { 0; 100; }
# note: <Func>
createLeanConcrete = Custom[CreateLeanConcrete](Element=valueAtKey, leanOffset=code_block_8.out0, leanThick=code_block_8.out1)  # CreateLeanConcreteForISOFDN
volume = Solid.Volume(solid=createLeanConcrete.Solid)
code_block_9 = CodeBlock(i=volume) { Math.Round(List.Flatten(i)/1000000000, 2); }
code_block_10 = CodeBlock { "M3"; }
count = List.Count(list=code_block_9)
ofRepeatedItem = List.OfRepeatedItem(item=code_block_10, amount=count)
code_block_11 = CodeBlock(FuncValues=code_block_9, FuncValuesUnit=ofRepeatedItem)
# ---------- code_block_11.designscript (4 lines) ----------
{
"FuncValues": _FuncValues,
"FuncValuesUnit": _FuncValuesUnit
};
# ----------------------------------------

# group: Output Manager
reference_output = CodeBlock(ref=createLeanConcrete.Solid) { ref; }
output = CodeBlock(MainOutput=code_block_11, RefOutput_geoColor=createLeanConcrete.Solid) { MainOutput; RefOutput_geoColor; }

# group: Visual Manager
visual_켜기_끄기 = BoolSelector(false)
visual_manager = Python(IN[0]=output.RefOutput_geoColor, IN[1]=visual_켜기_끄기)  # CPython3
# ---------- visual_manager.python (18 lines) ----------
# Load the Python Standard and DesignScript Libraries
import sys
import clr
clr.AddReference('ProtoGeometry')
from Autodesk.DesignScript.Geometry import *

# The inputs to this node will be stored as a list in the IN variables.
dataEnteringNode = IN
geoColors = IN[0]
blnForVisual = IN[1]

# Place your code below this line
if blnForVisual == True:
    result = geoColors
else:
    result = 0
# Assign your output to the OUT variable.
OUT = result
# ----------------------------------------

join = List.Join(list0=output.MainOutput)  # unwired: list1, list2, list3, list4, list5, list6, list7, list8, list9, list10

# group: TargetWMunique + Data Sending
code_block_12 = CodeBlock(InputDic2=join) { _InputDic2; }
count_2 = List.Count(list=code_block_12)
code_block_13 = CodeBlock(InputDic1=code_block_6) { _InputDic1; }
code_block_14 = CodeBlock { "TargetWMunique"; }
valueAtKey_2 = DesignScript.Builtin.Dictionary.ValueAtKey(dictionary=code_block_13, key=code_block_14)
watch_2 = Watch(valueAtKey_2)
count_3 = List.Count(list=watch_2)
eq = count_2 == count_3
organizeFuncValuesAndWorkMasterAsDiction = Custom[OrganizeFuncValuesAndWorkMasterAsDictionary](InputDic1=code_block_13, InputDic2=code_block_12)  # Organize FuncValues and WorkMaster As Dictionary
watch_3 = Watch()  # unwired: arg0
if_ = If(test=eq, true=organizeFuncValuesAndWorkMasterAsDiction, false=watch_3)

# group: Sample
code_block_15 = CodeBlock {  }
code_block_16 = CodeBlock {  }

Z = Point.Z()  # unwired: point
sort = List.Sort(list=Z)

# group: Primary Input
categories_2 = Categories("OST_Stairs")
all_elements_of_category_2 = ElementsOfCategory(Category=categories_2)
file_path_2 = Filename("..\1118\통합 문서3.xlsx")
file_from_path_2 = FileObject(path=file_path_2)
code_block_17 = CodeBlock { "Stairs"; }

# group: GetFull WMCodeDescription PerElement
code_block_18 = CodeBlock(InputElement=all_elements_of_category_2, InputFilePath=file_from_path_2, InputSheetName=code_block_17) { _InputElement; _InputFilePath; _InputSheetName; }
# note: .GetParameterValueByName("Family and Type")  로 수정함
excelDataManagerNode_2 = Python(IN[0]=code_block_18._InputElement, IN[1]=code_block_18._InputFilePath, IN[2]=code_block_18._InputSheetName)  # CPython3
# ---------- excelDataManagerNode_2.python (279 lines) ----------
# Load the Python Standard and DesignScript Libraries
import os
import sys
sys.path.append(os.getenv('LOCALAPPDATA').replace('\\','\\\\') + r'\Programs\Python\Python39\Lib\site-packages')
import clr
clr.AddReference('RevitAPI')
import Autodesk

clr.AddReference('ProtoGeometry')
from Autodesk.DesignScript.Geometry import *

clr.AddReference('RevitNodes')
import Revit
clr.ImportExtensions(Revit.Elements)

clr.ImportExtensions(Revit.GeometryConversion)
clr.ImportExtensions(Revit.GeometryReferences)

clr.AddReference('RevitServices')
import RevitServices
from RevitServices.Persistence import DocumentManager
from RevitServices.Transactions import TransactionManager

doc = DocumentManager.Instance.CurrentDBDocument

import random
import itertools
from functools import reduce
from collections import Iterable
import datetime
import openpyxl

def iterable(obj):
    return isinstance(obj, Iterable)

def findUnique(inputs):
    result = []
    for i in inputs:
        if i in result:
            pass
        else:
            result.append(i)
    return result

# The inputs to this node will be stored as a list in the IN variables.
dataEnteringNode = IN
inputElements = IN[0]
inputFilePath = IN[1]
inputSheetName = IN[2]

def importExcel(path, SheetNameIn):
    wb_obj = openpyxl.load_workbook(str(path), data_only=True)
    sheet_obj = wb_obj.get_sheet_by_name(str(SheetNameIn))

    m_row = sheet_obj.max_row
    m_col = sheet_obj.max_column

    listOut = []

    for i in range(1, m_row +1):
        listTemp = []
        for j in range(1, m_col + 1):
            cell_obj = sheet_obj.cell(row=i, column=j)
            listTemp.append(cell_obj.value)
            if len(listTemp) == m_col:
                listOut.append(listTemp)
    return listOut

def getUsedFamilyTypeOfModeling(elements):
    familyCode = list(map(lambda x: x.GetParameterValueByName("Family and Type").Name.split('_')[0], elements))
    unq_familyCode = findUnique(familyCode)
    return unq_familyCode
    
def createExcelDataDictionary(values):
    result = {}
    for i in range(len(values)):
        result[str(i)] = values[i]
    return result

def findTargetIndex(targets, list):
    result = []
    for target in targets:
        for i in range(len(list)):
            if target in str(list[i]):
                result.append(i)
            else:
                pass
    result.sort()
    return result
    
def GetValueAtKeys(keys, dictionary):
    result = [] 
    for i in keys:
        result.append(dictionary[str(i)])
    return result


# Place your code below this line
usedFamilyTypeOfModeling = getUsedFamilyTypeOfModeling(inputElements)
excelWholeDataSet = importExcel(inputFilePath, inputSheetName)
trExcelWholeDataSet = list(zip(*excelWholeDataSet))
excelColumnDataSet = createExcelDataDictionary(trExcelWholeDataSet)
excelRowDataSet = createExcelDataDictionary(excelWholeDataSet)
ColumnIndexOfUsedFamilyType = findTargetIndex(usedFamilyTypeOfModeling, trExcelWholeDataSet)
ColDataSetOfUsedFamilyType = GetValueAtKeys(ColumnIndexOfUsedFamilyType, excelColumnDataSet)
materialPerElementFromModeling = []
for i in inputElements:
    materialPerElementFromModeling.append(i.GetMaterials())
#list(map(lambda x: x.GetMaterials, inputElements)) "맵함수로 처리하면 리스트화 할 때 타입 변환 오류 남"

targetWMRowIndex = []
for i in ColDataSetOfUsedFamilyType:
    targetWMRowIndex.append(findTargetIndex(['000'], i))

rowDataSetOfUsedWM = []
for i in targetWMRowIndex:
    rowDataSetOfUsedWM.append(GetValueAtKeys(i, excelRowDataSet))

workGroup = []
for i in rowDataSetOfUsedWM:
    tmp = []
    for j in i:
        tmp.append(j[0])
    workGroup.append(tmp)
    
workMaster = []
for i in range(len(ColDataSetOfUsedFamilyType)):
    tmp=[]
    for k in targetWMRowIndex[i]:
        tmp.append(ColDataSetOfUsedFamilyType[i][k])
    workMaster.append(tmp)

matchedWM = []
for i in range(len(workGroup)):
    tmp = []
    for j in range(len(workGroup[i])):
        fullWM = workGroup[i][j] +"-"+ workMaster[i][j]
        tmp.append(fullWM)
    matchedWM.append(tmp)

matchedWorkGruopAndMasterCode = []
for i in matchedWM:
    if len(i) > 0:
        matchedWorkGruopAndMasterCode.append(i)
    else:
        pass

matchedWMDescription = []
for i in rowDataSetOfUsedWM:
    tmp=[]
    for j in i:
        tmp.append(j[1] +" "+ j[2] +" "+ j[3] +" "+ "("+ j[4] +")")
    if len(tmp) > 0:
        matchedWMDescription.append(tmp)
    else:
        pass

matchedWMUnit = []
for i in rowDataSetOfUsedWM:
    tmp=[]
    for j in i:
        tmp.append(j[4])
    if len(tmp) > 0:
        matchedWMUnit.append(tmp)
    else:
        pass

matchedWorkGruopAndMasterCode_flat = list(itertools.chain(*matchedWorkGruopAndMasterCode))
matchedWMDescription_flat = list(itertools.chain(*matchedWMDescription))

dic_WMandDescription_Excel = {}
for i in range(len(matchedWorkGruopAndMasterCode_flat)):
    dic_WMandDescription_Excel[matchedWorkGruopAndMasterCode_flat[i]] = matchedWMDescription_flat[i]

usedFamilyTypeInExcelOrder = list(map(lambda x: x[3], ColDataSetOfUsedFamilyType))
usedFamilyCodeInExcelOrder = findUnique(list(map(lambda x: x.split('_')[0], usedFamilyTypeInExcelOrder)))

dic_FamilyCodeandWM = {}
for i in range(len(usedFamilyCodeInExcelOrder)):
    dic_FamilyCodeandWM[usedFamilyCodeInExcelOrder[i]] = matchedWorkGruopAndMasterCode[i]

workMasterCodePerElement = []
familyCodePerElem = list(map(lambda x: x.GetParameterValueByName("Family and Type").Name.split('_')[0], inputElements))
for i in familyCodePerElem:
    workMasterCodePerElement.append(dic_FamilyCodeandWM[i])

materialNamePerElem = []
for i in materialPerElementFromModeling:
    tmp = []
    for j in i:
        tmp.append(j.Name)
    materialNamePerElem.append(tmp)

WMPerElementFromModeling = []
for i in materialNamePerElem:
    tmp = []
    for j in i:
        tmp.append(j.split('_')[0])
    WMPerElementFromModeling.append(tmp)

specPerElementFromModeling = []
for i in materialNamePerElem:
    tmp = []
    for j in i:
        a = j.split('_')
        del a[0]
        b = " ".join(a)
        tmp.append(b)
    specPerElementFromModeling.append(tmp)

WMPerElementFromModeling_flat = list(itertools.chain(*WMPerElementFromModeling))
specPerElementFromModeling_flat = list(itertools.chain(*specPerElementFromModeling))

dic_WMandDescription_Model = {}
for i in range(len(WMPerElementFromModeling_flat)):
    dic_WMandDescription_Model[WMPerElementFromModeling_flat[i]] = specPerElementFromModeling_flat[i]

def findAllKeys(dict):
    result = []
    for key in dict.keys():
        result.append(key)
    return result

def findAllValues(dict):
    result = []
    for key in dict.keys():
        result.append(dict[key])
    return result

keys_WMandDescription_Model = findAllKeys(dic_WMandDescription_Model)
keys_WMandDescription_Excel = findAllKeys(dic_WMandDescription_Excel)

keys_WMandDescription_Both = list(set(keys_WMandDescription_Model + keys_WMandDescription_Excel))
values_WMandDescription_Both = []
for i in keys_WMandDescription_Both:
    if i in keys_WMandDescription_Model:
        values_WMandDescription_Both.append(dic_WMandDescription_Model[i])
    else:
        values_WMandDescription_Both.append(dic_WMandDescription_Excel[i])

dic_WMandDescription_Both = {}
for i in range(len(keys_WMandDescription_Both)):
    dic_WMandDescription_Both[keys_WMandDescription_Both[i]] = values_WMandDescription_Both[i]

workMasterCodePerElementFromBoth = []
for i in range(len(workMasterCodePerElement)):
    #tmp = []
    a = WMPerElementFromModeling[i] + workMasterCodePerElement[i]
    b = findUnique(a)
    workMasterCodePerElementFromBoth.append(b)

specPerElement = []
for i in workMasterCodePerElementFromBoth:
    tmp = []
    for j in i:
        tmp.append(dic_WMandDescription_Both[j])
    specPerElement.append(tmp)

fullWMCodeDescriptionPerElement = []
for i in range(len(workMasterCodePerElementFromBoth)):
    tmp = []
    for j in range(len(workMasterCodePerElementFromBoth[i])):
        a = workMasterCodePerElementFromBoth[i][j] +": "+ specPerElement[i][j]
        tmp.append(a)
    fullWMCodeDescriptionPerElement.append(tmp)

fullWMinfo = {
"AllElement": inputElements,
"WorkMasterCodePerFamilyType": dic_FamilyCodeandWM,
"WorkMasterCodePerElementBoth": workMasterCodePerElementFromBoth,
"FullWMCodeDescriptionPerElement": fullWMCodeDescriptionPerElement
}



result = fullWMinfo

# Assign your output to the OUT variable.
OUT = result
# ----------------------------------------

# group: Organize AllElementInform AsDictionary
set_up_all_element_inform_as_2 = Python(IN[0]=excelDataManagerNode_2)  # "Set Up All Element Inform as Dictionary"; CPython3; same code as set_up_all_element_inform_as

# group: Select Target Family Element And Connected WorkMasters
code_block_19 = CodeBlock { 0; }
select_target_family_element_and_2 = Python(IN[0]=set_up_all_element_inform_as_2, IN[1]=code_block_19)  # "Select Target Family Element And Connected WorkMasters"; CPython3; same code as select_target_family_element_and

watch_4 = Watch(select_target_family_element_and_2)
# note: Excel 정리 후 재검토 해야함
# 스틸 / 콘크리트 정리 및 확인 필요
code_block_20 = CodeBlock(i=watch_4) { i; }

# group: Input Manager
value_for_import_from_others_2 = CodeBlock(MainInput=code_block_20) { MainInput; RefInput1; RefInput2; }  # unwired: RefInput1, RefInput2

# group: <Func 6,8> 계단과 벽체가 만나는 지점에서 Nosing을 잇는 선을 100mm offset하고 그 경계 하부 면적을 계산
# note: <Func>
code_block_21 = CodeBlock { "TargetElements"; }
valueAtKey_3 = DesignScript.Builtin.Dictionary.ValueAtKey(dictionary=value_for_import_from_others_2.MainInput, key=code_block_21)

geometry = Element.Geometry(element=valueAtKey_3)
explode = Geometry.Explode(geometry=geometry)
flatten = List.Flatten(list=explode)
# note: <Func>
extractUpperFacesOfElement = Custom[ExtractUpperFacesOfElement](Element=valueAtKey_3)  # ExtractUpperFacesOfElement
flatten_2 = List.Flatten(list=extractUpperFacesOfElement.Surface)
byJoinedSurfaces = PolySurface.ByJoinedSurfaces(surfaces=flatten_2)
doesIntersect = Geometry.DoesIntersect(geometry=byJoinedSurfaces, other=flatten, lacing=CrossProduct)
filterByBoolMask = List.FilterByBoolMask(list=flatten, mask=doesIntersect@L2)
perimeterCurves = Surface.PerimeterCurves(surface=filterByBoolMask.out@L1)
startPoint = Curve.StartPoint(curve=perimeterCurves)
boolean = BoolSelector(true)
byPoints = PolyCurve.ByPoints(points=startPoint, connectLastToFirst=boolean)
flatten_3 = List.Flatten(list=filterByBoolMask.out)
code_block_22 = CodeBlock { 450; }
translate = Geometry.Translate(geometry=flatten_3, zTranslation=code_block_22)
perimeterCurves_2 = Surface.PerimeterCurves(surface=translate)
startPoint_2 = Curve.StartPoint(curve=perimeterCurves_2)
boolean_2 = BoolSelector(true)
byPoints_2 = PolyCurve.ByPoints(points=startPoint_2, connectLastToFirst=boolean_2)
list_create = List.Create(item0=byPoints, item1=byPoints_2)
transpose = List.Transpose(lists=list_create)
byLoft = Solid.ByLoft(crossSections=transpose)
isNull = Object.IsNull(object=byLoft)
filterByBoolMask_2 = List.FilterByBoolMask(list=byLoft, mask=isNull)
byUnion = Solid.ByUnion(solids=filterByBoolMask_2.out)
geometry_2 = Element.Geometry(element=valueAtKey_3)
flatten_4 = List.Flatten(list=geometry_2)
byUnion_2 = Solid.ByUnion(solids=flatten_4)
differenceAll = Solid.DifferenceAll(solid=byUnion, others=byUnion_2)
explode_2 = Geometry.Explode(geometry=differenceAll)
code_block_23 = CodeBlock { 0.5; }
normalAtParameter = Surface.NormalAtParameter(surface=explode_2, u=code_block_23, v=code_block_23)

# group: func2 (ExtractSideFacesOfElement)
Z_2 = Vector.Z(vector=normalAtParameter)
code_block_24 = CodeBlock { 0; }
round = Math.Round(number=Z_2, digits=code_block_24)
code_block_25 = CodeBlock(i=round) { i<1 && i>-1; }
filterByBoolMask_3 = List.FilterByBoolMask(list=explode_2, mask=code_block_25)
color_palette = ColorPalette({R: 255, G: 0, B: 255, A: 136})
byGeometryColor = Modifiers.GeometryColor.ByGeometryColor(geometry=filterByBoolMask_3.in, color=color_palette)
code_block_26 = CodeBlock { Surface; }
code_block_27 = CodeBlock { GeometryColor; }

watch_5 = Watch(filterByBoolMask_3.in)
separate = Solid.Separate(solid=differenceAll)
doesIntersect_2 = Geometry.DoesIntersect(geometry=separate, other=watch_5, lacing=CrossProduct)
filterByBoolMask_4 = List.FilterByBoolMask(list=watch_5, mask=doesIntersect_2@L2)
watch_6 = Watch(filterByBoolMask_4.in)
watch_7 = Watch(filterByBoolMask_3.out)
separate_2 = Solid.Separate(solid=differenceAll)
doesIntersect_3 = Geometry.DoesIntersect(geometry=separate_2, other=watch_7, lacing=CrossProduct)
filterByBoolMask_5 = List.FilterByBoolMask(list=watch_7, mask=doesIntersect_3@L2)
watch_8 = Watch(filterByBoolMask_5.in)
area = Surface.Area(surface=watch_8)
code_block_28 = CodeBlock { 0; }
round_2 = Math.Round(number=area, digits=code_block_28)
area_2 = Surface.Area()  # unwired: surface
minimumItemByKey = List.MinimumItemByKey(list=watch_8@L2, keyFunction=area_2)
watch_9 = Watch(minimumItemByKey)
area_3 = Surface.Area(surface=watch_9)
code_block_29 = CodeBlock { 0; }
round_3 = Math.Round(number=area_3, digits=code_block_29)
eq_2 = round_2@L2 == round_3@L1  # lacing=Shortest
filterByBoolMask_6 = List.FilterByBoolMask(list=watch_8@L2, mask=eq_2@L2)
flatten_5 = List.Flatten(list=filterByBoolMask_6.in)
flatten_6 = List.Flatten(list=flatten_5)
countTrue = List.CountTrue(list=eq_2@L2)
code_block_30 = CodeBlock(a=countTrue) { a/2; }
code_block_31 = CodeBlock { 2; }
ofRepeatedItem_2 = List.OfRepeatedItem(item=code_block_30, amount=code_block_31)
transpose_2 = List.Transpose(lists=ofRepeatedItem_2)
flatten_7 = List.Flatten(list=transpose_2)
chop = List.Chop(list=flatten_6, lengths=flatten_7)
code_block_32 = CodeBlock { 0.5; }
pointAtParameter = Surface.PointAtParameter(surface=chop, u=code_block_32, v=code_block_32)
byPoints_3 = PolyCurve.ByPoints(points=pointAtParameter)
code_block_33 = CodeBlock { 200; }
extendStart = Curve.ExtendStart(curve=byPoints_3, distance=code_block_33)
startPoint_3 = Curve.StartPoint(curve=extendStart)
code_block_34 = CodeBlock { 2; }
chop_2 = List.Chop(list=startPoint_3, lengths=code_block_34)
extendEnd = Curve.ExtendEnd(curve=byPoints_3, distance=code_block_33)
endPoint = Curve.EndPoint(curve=extendEnd)
code_block_35 = CodeBlock { 2; }
chop_3 = List.Chop(list=endPoint, lengths=code_block_35)
addItemToFront = List.AddItemToFront(item=chop_2@L2, list=chop_3@L2)
flatten_8 = List.Flatten(list=addItemToFront@L3)
sortByFunction = List.SortByFunction(list=flatten_8@L2, sortFunction=Z)
byPoints_4 = PolyCurve.ByPoints(points=sortByFunction)
doesIntersect_4 = Geometry.DoesIntersect(geometry=watch_6@L2, other=byPoints_4@L1)
filterByBoolMask_7 = List.FilterByBoolMask(list=watch_6, mask=doesIntersect_4)
watch_10 = Watch(filterByBoolMask_7.out)
code_block_36 = CodeBlock { 1200; }
translate_2 = Geometry.Translate(geometry=byPoints_4, zTranslation=code_block_36)
list_create_2 = List.Create(item0=byPoints_4, item1=translate_2)
transpose_3 = List.Transpose(lists=list_create_2)
byLoft_2 = Surface.ByLoft(crossSections=transpose_3)
code_block_37 = CodeBlock { 300; }
thicken = Surface.Thicken(surface=byLoft_2, thickness=code_block_37)
doesIntersect_5 = Geometry.DoesIntersect(geometry=watch_10@L2, other=thicken@L1)
filterByBoolMask_8 = List.FilterByBoolMask(list=watch_10, mask=doesIntersect_5)
flatten_9 = List.Flatten(list=filterByBoolMask_8.out)
byStartPointEndPoint = Line.ByStartPointEndPoint()  # unwired: startPoint, endPoint

# group: Input Manager
value_for_import_from_others_3 = CodeBlock(MainInput=code_block_20) { MainInput; RefInput1; RefInput2; }  # unwired: RefInput1, RefInput2

# group: <Func 1> 콘크리트 체적
code_block_38 = CodeBlock { "TargetElements"; }
valueAtKey_4 = DesignScript.Builtin.Dictionary.ValueAtKey(dictionary=value_for_import_from_others_3.MainInput, key=code_block_38)
# note: <Func>
geometry_3 = Element.Geometry(element=valueAtKey_4)
flatten_10 = List.Flatten(list=geometry_3@L2)
volume_2 = Solid.Volume(solid=flatten_10)
sum = Math.Sum(values=volume_2)
code_block_39 = CodeBlock(i=sum) { Math.Round(List.Flatten(i)/1000000000, 2); }
code_block_40 = CodeBlock { "M3"; }
count_4 = List.Count(list=code_block_39)
ofRepeatedItem_3 = List.OfRepeatedItem(item=code_block_40, amount=count_4)
code_block_41 = CodeBlock(FuncValues=code_block_39, FuncValuesUnit=ofRepeatedItem_3)  # same code as code_block_11

watch_11 = Watch(code_block_41)

# group: Input Manager
value_for_import_from_others_4 = CodeBlock(MainInput=code_block_20) { MainInput; RefInput1; RefInput2; }  # unwired: RefInput1, RefInput2

# group: <Func 3> 콘크리트 체적 (Rebar)
code_block_42 = CodeBlock { "TargetElements"; }
valueAtKey_5 = DesignScript.Builtin.Dictionary.ValueAtKey(dictionary=value_for_import_from_others_4.MainInput, key=code_block_42)
# note: <Func>
geometry_4 = Element.Geometry(element=valueAtKey_5)
flatten_11 = List.Flatten(list=geometry_4@L2)
volume_3 = Solid.Volume(solid=flatten_11)
flatten_12 = List.Flatten(list=volume_3)
sum_2 = Math.Sum(values=volume_3)
# note: 비율 추가
code_block_43 = CodeBlock(i=sum_2) { Math.Round(List.Flatten(i)/1000000000, 2); }
code_block_44 = CodeBlock { "TON"; }
sog_철근비 = DoubleInput(0)  # graph input
mul = code_block_43 * sog_철근비
code_block_45 = CodeBlock(i=mul) { Math.Round(List.Flatten(i)/1, 2); }
count_5 = List.Count(list=code_block_45)
ofRepeatedItem_4 = List.OfRepeatedItem(item=code_block_44, amount=count_5)
code_block_46 = CodeBlock(FuncValues=code_block_43, FuncValuesUnit=ofRepeatedItem_4)  # same code as code_block_11

# group: <Func 4> 계단 하부노출면
# note: 철골 / 콘크리트 분리코
code_block_47 = CodeBlock { "TargetElements"; }
valueAtKey_6 = DesignScript.Builtin.Dictionary.ValueAtKey(key=code_block_47)  # unwired: dictionary
geometry_5 = Element.Geometry(element=valueAtKey_6)
explode_3 = Geometry.Explode(geometry=geometry_5)
flatten_13 = List.Flatten(list=explode_3)
# note: <Func>
extractUpperFacesOfElement_2 = Custom[ExtractUpperFacesOfElement](Element=valueAtKey_6)
flatten_14 = List.Flatten(list=extractUpperFacesOfElement_2.Surface)
byJoinedSurfaces_2 = PolySurface.ByJoinedSurfaces(surfaces=flatten_14)
doesIntersect_6 = Geometry.DoesIntersect(geometry=byJoinedSurfaces_2, other=flatten_13, lacing=CrossProduct)
filterByBoolMask_9 = List.FilterByBoolMask(list=flatten_13, mask=doesIntersect_6@L2)
flatten_15 = List.Flatten(list=filterByBoolMask_9.out)
area_4 = Surface.Area(surface=flatten_15)
sum_3 = Math.Sum(values=area_4)
code_block_48 = CodeBlock(i=sum_3) { Math.Round(List.Flatten(i)/1000000, 2); }
code_block_49 = CodeBlock { "M2"; }
count_6 = List.Count(list=code_block_48)
ofRepeatedItem_5 = List.OfRepeatedItem(item=code_block_49, amount=count_6)
code_block_50 = CodeBlock(FuncValues=code_block_48, FuncValuesUnit=ofRepeatedItem_5)  # same code as code_block_11

watch_12 = Watch(code_block_50)

# group: <Func 5> 계단 상부노출면
# note: 철골 / 콘크리트 분리코
code_block_51 = CodeBlock { "TargetElements"; }
valueAtKey_7 = DesignScript.Builtin.Dictionary.ValueAtKey(key=code_block_51)  # unwired: dictionary
# note: <Func>
extractUpperFacesOfElement_3 = Custom[ExtractUpperFacesOfElement](Element=valueAtKey_7)
flatten_16 = List.Flatten(list=extractUpperFacesOfElement_3.Surface)
area_5 = Surface.Area(surface=flatten_16)
sum_4 = Math.Sum(values=area_5)
code_block_52 = CodeBlock(i=sum_4) { Math.Round(List.Flatten(i)/1000000, 2); }
code_block_53 = CodeBlock { "M2"; }
count_7 = List.Count(list=code_block_52)
ofRepeatedItem_6 = List.OfRepeatedItem(item=code_block_53, amount=count_7)
code_block_54 = CodeBlock(FuncValues=code_block_52, FuncValuesUnit=ofRepeatedItem_6)  # same code as code_block_11

watch_13 = Watch(code_block_54)

# group: Input Manager
value_for_import_from_others_5 = CodeBlock(MainInput=code_block_20) { MainInput; RefInput1; RefInput2; }  # unwired: RefInput1, RefInput2

# group: <Func 7,9,10> 계단 상부노출면 + Riser 노출면
code_block_55 = CodeBlock { "TargetElements"; }
valueAtKey_8 = DesignScript.Builtin.Dictionary.ValueAtKey(dictionary=value_for_import_from_others_5.MainInput, key=code_block_55)
# note: <Func>
extractUpperFacesOfElement_4 = Custom[ExtractUpperFacesOfElement](Element=valueAtKey_8)
flatten_17 = List.Flatten(list=extractUpperFacesOfElement_4.Surface)
flatten_18 = List.Flatten(list=filterByBoolMask_7.in)
list_create_3 = List.Create(item0=flatten_17, item1=flatten_18)
flatten_19 = List.Flatten(list=list_create_3)
area_6 = Surface.Area(surface=flatten_19)
sum_5 = Math.Sum(values=area_6)
code_block_56 = CodeBlock(i=sum_5) { Math.Round(List.Flatten(i)/1000000, 2); }
code_block_57 = CodeBlock { "M2"; }
count_8 = List.Count(list=code_block_56)
ofRepeatedItem_7 = List.OfRepeatedItem(item=code_block_57, amount=count_8)
code_block_58 = CodeBlock(FuncValues=code_block_56, FuncValuesUnit=ofRepeatedItem_7)  # same code as code_block_11
watch_14 = Watch(code_block_58)

# group: Output Manager
reference_output_2 = CodeBlock { ref; }  # unwired: ref
output_2 = CodeBlock(MainOutput=code_block_41) { MainOutput; RefOutput_geoColor; }  # unwired: RefOutput_geoColor

# group: Input Manager
value_for_import_from_others_6 = CodeBlock(MainInput=code_block_20) { MainInput; RefInput1; RefInput2; }  # unwired: RefInput1, RefInput2

# group: <Func 2> 하부/측면/Riser 면적산출
code_block_59 = CodeBlock { "TargetElements"; }
valueAtKey_9 = DesignScript.Builtin.Dictionary.ValueAtKey(dictionary=value_for_import_from_others_6.MainInput, key=code_block_59)
geometry_6 = Element.Geometry(element=valueAtKey_9)
explode_4 = Geometry.Explode(geometry=geometry_6)
flatten_20 = List.Flatten(list=explode_4)
# note: <Func>
extractUpperFacesOfElement_5 = Custom[ExtractUpperFacesOfElement](Element=valueAtKey_9)
flatten_21 = List.Flatten(list=extractUpperFacesOfElement_5.Surface)
byJoinedSurfaces_3 = PolySurface.ByJoinedSurfaces(surfaces=flatten_21)
doesIntersect_7 = Geometry.DoesIntersect(geometry=byJoinedSurfaces_3, other=flatten_20, lacing=CrossProduct)
filterByBoolMask_10 = List.FilterByBoolMask(list=flatten_20, mask=doesIntersect_7@L2)
code_block_60 = CodeBlock { "M2"; }

# group: Element Side 노드 수정
code_block_61 = CodeBlock(Element=valueAtKey_9) { _Element: var[]..[]; }
code_block_62 = CodeBlock(Element=code_block_61) { _Element; }
geometry_7 = Element.Geometry(element=code_block_62)
explode_5 = Geometry.Explode(geometry=geometry_7)
code_block_63 = CodeBlock { 0.5; }
normalAtParameter_2 = Surface.NormalAtParameter(surface=explode_5, u=code_block_63, v=code_block_63)
Z_3 = Vector.Z(vector=normalAtParameter_2)
code_block_64 = CodeBlock { 0; }
round_4 = Math.Round(number=Z_3, digits=code_block_64)
code_block_65 = CodeBlock(i=round_4) { i<1 && i>-1; }
filterByBoolMask_11 = List.FilterByBoolMask(list=explode_5, mask=code_block_65)
color_palette_2 = ColorPalette({R: 255, G: 0, B: 255, A: 136})
byGeometryColor_2 = Modifiers.GeometryColor.ByGeometryColor(geometry=filterByBoolMask_11.in, color=color_palette_2)

# group (continued): <Func 2> 하부/측면/Riser 면적산출
list_create_4 = List.Create(item0=filterByBoolMask_11.in, item1=filterByBoolMask_10.out)
flatten_22 = List.Flatten(list=list_create_4@L3)
area_7 = Surface.Area(surface=flatten_22)
sum_6 = Math.Sum(values=area_7@L2)
code_block_66 = CodeBlock(i=sum_6) { Math.Round(List.Flatten(i)/1000000, 2); }
count_9 = List.Count(list=code_block_66)
ofRepeatedItem_8 = List.OfRepeatedItem(item=code_block_60, amount=count_9)
code_block_67 = CodeBlock(FuncValues=code_block_66, FuncValuesUnit=ofRepeatedItem_8)  # same code as code_block_11

watch_15 = Watch(code_block_67)

# group: Output Manager
reference_output_3 = CodeBlock { ref; }  # unwired: ref
output_3 = CodeBlock(MainOutput=watch_15) { MainOutput; RefOutput_geoColor; }  # unwired: RefOutput_geoColor

watch_16 = Watch(code_block_46)

# group: Output Manager
reference_output_4 = CodeBlock { ref; }  # unwired: ref
output_4 = CodeBlock(MainOutput=watch_16) { MainOutput; RefOutput_geoColor; }  # unwired: RefOutput_geoColor

# group: Output Manager
reference_output_5 = CodeBlock { ref; }  # unwired: ref
output_5 = CodeBlock { MainOutput; RefOutput_geoColor; }  # unwired: MainOutput, RefOutput_geoColor

# group: Input Manager
value_for_import_from_others_7 = CodeBlock(MainInput=code_block_20) { MainInput; RefInput1; RefInput2; }  # unwired: RefInput1, RefInput2

# group: Input Manager
value_for_import_from_others_8 = CodeBlock(MainInput=code_block_20) { MainInput; RefInput1; RefInput2; }  # unwired: RefInput1, RefInput2

# group: Output Manager
reference_output_6 = CodeBlock { ref; }  # unwired: ref
output_6 = CodeBlock { MainOutput; RefOutput_geoColor; }  # unwired: MainOutput, RefOutput_geoColor

# group: Output Manager
reference_output_7 = CodeBlock { ref; }  # unwired: ref
output_7 = CodeBlock { MainOutput; RefOutput_geoColor; }  # unwired: MainOutput, RefOutput_geoColor

# group: Output Manager
reference_output_8 = CodeBlock { ref; }  # unwired: ref
output_8 = CodeBlock { MainOutput; RefOutput_geoColor; }  # unwired: MainOutput, RefOutput_geoColor

# group: func2
# note: 계단 모델링 방식에 따라 인식하는 Geometry가 다르다. 해당 부분 확인 필요ㄹ
code_block_68 = CodeBlock(Element=valueAtKey_3) { _Element: var[]..[]; }
code_block_69 = CodeBlock(Element=code_block_68) { _Element; }
faces = Element.Faces(element=code_block_69)
faces_2 = Element.Faces()  # unwired: element
code_block_70 = CodeBlock { 0.5; }
normalAtParameter_3 = Surface.NormalAtParameter(u=code_block_70, v=code_block_70)  # unwired: surface
function_compose = ComposeFunctions(function0=faces_2, function1=normalAtParameter_3)
function_apply = ApplyFunction(function=function_compose, argument0=code_block_69)
Z_4 = Vector.Z(vector=function_apply)
code_block_71 = CodeBlock { 0; }
round_5 = Math.Round(number=Z_4, digits=code_block_71)
code_block_72 = CodeBlock(i=round_5) { i==1; }
filterByBoolMask_12 = List.FilterByBoolMask(list=faces, mask=code_block_72)
color_palette_3 = ColorPalette({R: 238, G: 232, B: 170, A: 128})
byGeometryColor_3 = Modifiers.GeometryColor.ByGeometryColor(geometry=filterByBoolMask_12.in, color=color_palette_3)
code_block_73 = CodeBlock { Surface; }
code_block_74 = CodeBlock { GeometryColor; }

# group: Element Side 노드 수정
code_block_75 = CodeBlock(Element=valueAtKey_3) { _Element: var[]..[]; }
code_block_76 = CodeBlock(Element=code_block_75) { _Element; }
geometry_8 = Element.Geometry(element=code_block_76)
explode_6 = Geometry.Explode(geometry=geometry_8)
code_block_77 = CodeBlock { 0.5; }
normalAtParameter_4 = Surface.NormalAtParameter(surface=explode_6, u=code_block_77, v=code_block_77)
Z_5 = Vector.Z(vector=normalAtParameter_4)
code_block_78 = CodeBlock { 0; }
round_6 = Math.Round(number=Z_5, digits=code_block_78)
code_block_79 = CodeBlock(i=round_6) { i<1 && i>-1; }
filterByBoolMask_13 = List.FilterByBoolMask(list=explode_6, mask=code_block_79)
color_palette_4 = ColorPalette({R: 255, G: 0, B: 255, A: 136})
byGeometryColor_4 = Modifiers.GeometryColor.ByGeometryColor(geometry=filterByBoolMask_13.in, color=color_palette_4)
