# Dynamo graph 03 Str Column (1116).dyn (Dynamo 2.10.1.3976)

# group: export to excel
file_path = Filename("C:\Users\HEC\Desktop\11.xlsx")
code_block = CodeBlock { "Sheet1"; }
code_block_2 = CodeBlock { 1; }
code_block_3 = CodeBlock { true; }
exportExcel = Data.ExportExcel(filePath=file_path, sheetName=code_block, startRow=code_block_2, startCol=code_block_2, overWrite=code_block_3)  # unwired: data

code_block_4 = CodeBlock { "..."; }
split = String.Split(separator0=code_block_4)  # unwired: str
code_block_5 = CodeBlock { "..."; }
split_2 = String.Split(separator0=code_block_5)  # unwired: str
join = List.Join(list0=split, list1=split_2)

# group: Primary Input
categories = Categories("OST_StructuralColumns")
all_elements_of_category = ElementsOfCategory(Category=categories)
file_path_2 = Filename("..\1118\통합 문서3.xlsx")
file_from_path = FileObject(path=file_path_2)
code_block_6 = CodeBlock { "Str Columns"; }

# group: GetFull WMCodeDescription PerElement
code_block_7 = CodeBlock(InputElement=all_elements_of_category, InputFilePath=file_from_path, InputSheetName=code_block_6) { _InputElement; _InputFilePath; _InputSheetName; }
excelDataManagerNode = Python(IN[0]=code_block_7._InputElement, IN[1]=code_block_7._InputFilePath, IN[2]=code_block_7._InputSheetName)  # CPython3
# ---------- excelDataManagerNode.python (279 lines) ----------
# Load the Python Standard and DesignScript Libraries
import os
import sys
sys.path.append(os.getenv('LOCALAPPDATA').replace('\\','\\\\') + r'\Programs\Python\Python39\Lib\site-packages')
import clr
clr.AddReference('RevitAPI')
import Autodesk

clr.AddReference('ProtoGeometry')
from Autodesk.DesignScript.Geometry import *

clr.AddReference('RevitNodes')
import Revit
clr.ImportExtensions(Revit.Elements)

clr.ImportExtensions(Revit.GeometryConversion)
clr.ImportExtensions(Revit.GeometryReferences)

clr.AddReference('RevitServices')
import RevitServices
from RevitServices.Persistence import DocumentManager
from RevitServices.Transactions import TransactionManager

doc = DocumentManager.Instance.CurrentDBDocument

import random
import itertools
from functools import reduce
from collections import Iterable
import datetime
import openpyxl

def iterable(obj):
    return isinstance(obj, Iterable)

def findUnique(inputs):
    result = []
    for i in inputs:
        if i in result:
            pass
        else:
            result.append(i)
    return result

# The inputs to this node will be stored as a list in the IN variables.
dataEnteringNode = IN
inputElements = IN[0]
inputFilePath = IN[1]
inputSheetName = IN[2]

def importExcel(path, SheetNameIn):
    wb_obj = openpyxl.load_workbook(str(path), data_only=True)
    sheet_obj = wb_obj.get_sheet_by_name(str(SheetNameIn))

    m_row = sheet_obj.max_row
    m_col = sheet_obj.max_column

    listOut = []

    for i in range(1, m_row +1):
        listTemp = []
        for j in range(1, m_col + 1):
            cell_obj = sheet_obj.cell(row=i, column=j)
            listTemp.append(cell_obj.value)
            if len(listTemp) == m_col:
                listOut.append(listTemp)
    return listOut

def getUsedFamilyTypeOfModeling(elements):
    familyCode = list(map(lambda x: x.Name.split('_')[0], elements))
    unq_familyCode = findUnique(familyCode)
    return unq_familyCode
    
def createExcelDataDictionary(values):
    result = {}
    for i in range(len(values)):
        result[str(i)] = values[i]
    return result

def findTargetIndex(targets, list):
    result = []
    for target in targets:
        for i in range(len(list)):
            if target in str(list[i]):
                result.append(i)
            else:
                pass
    result.sort()
    return result
    
def GetValueAtKeys(keys, dictionary):
    result = [] 
    for i in keys:
        result.append(dictionary[str(i)])
    return result


# Place your code below this line
usedFamilyTypeOfModeling = getUsedFamilyTypeOfModeling(inputElements)
excelWholeDataSet = importExcel(inputFilePath, inputSheetName)
trExcelWholeDataSet = list(zip(*excelWholeDataSet))
excelColumnDataSet = createExcelDataDictionary(trExcelWholeDataSet)
excelRowDataSet = createExcelDataDictionary(excelWholeDataSet)
ColumnIndexOfUsedFamilyType = findTargetIndex(usedFamilyTypeOfModeling, trExcelWholeDataSet)
ColDataSetOfUsedFamilyType = GetValueAtKeys(ColumnIndexOfUsedFamilyType, excelColumnDataSet)
materialPerElementFromModeling = []
for i in inputElements:
    materialPerElementFromModeling.append(i.GetMaterials())
#list(map(lambda x: x.GetMaterials, inputElements)) "맵함수로 처리하면 리스트화 할 때 타입 변환 오류 남"

targetWMRowIndex = []
for i in ColDataSetOfUsedFamilyType:
    targetWMRowIndex.append(findTargetIndex(['000'], i))

rowDataSetOfUsedWM = []
for i in targetWMRowIndex:
    rowDataSetOfUsedWM.append(GetValueAtKeys(i, excelRowDataSet))

workGroup = []
for i in rowDataSetOfUsedWM:
    tmp = []
    for j in i:
        tmp.append(j[0])
    workGroup.append(tmp)
    
workMaster = []
for i in range(len(ColDataSetOfUsedFamilyType)):
    tmp=[]
    for k in targetWMRowIndex[i]:
        tmp.append(ColDataSetOfUsedFamilyType[i][k])
    workMaster.append(tmp)

matchedWM = []
for i in range(len(workGroup)):
    tmp = []
    for j in range(len(workGroup[i])):
        fullWM = workGroup[i][j] +"-"+ workMaster[i][j]
        tmp.append(fullWM)
    matchedWM.append(tmp)

matchedWorkGruopAndMasterCode = []
for i in matchedWM:
    if len(i) > 0:
        matchedWorkGruopAndMasterCode.append(i)
    else:
        pass

matchedWMDescription = []
for i in rowDataSetOfUsedWM:
    tmp=[]
    for j in i:
        tmp.append(j[1] +" "+ j[2] +" "+ j[3] +" "+ "("+ j[4] +")")
    if len(tmp) > 0:
        matchedWMDescription.append(tmp)
    else:
        pass

matchedWMUnit = []
for i in rowDataSetOfUsedWM:
    tmp=[]
    for j in i:
        tmp.append(j[4])
    if len(tmp) > 0:
        matchedWMUnit.append(tmp)
    else:
        pass

matchedWorkGruopAndMasterCode_flat = list(itertools.chain(*matchedWorkGruopAndMasterCode))
matchedWMDescription_flat = list(itertools.chain(*matchedWMDescription))

dic_WMandDescription_Excel = {}
for i in range(len(matchedWorkGruopAndMasterCode_flat)):
    dic_WMandDescription_Excel[matchedWorkGruopAndMasterCode_flat[i]] = matchedWMDescription_flat[i]

usedFamilyTypeInExcelOrder = list(map(lambda x: x[3], ColDataSetOfUsedFamilyType))
usedFamilyCodeInExcelOrder = findUnique(list(map(lambda x: x.split('_')[0], usedFamilyTypeInExcelOrder)))

dic_FamilyCodeandWM = {}
for i in range(len(usedFamilyCodeInExcelOrder)):
    dic_FamilyCodeandWM[usedFamilyCodeInExcelOrder[i]] = matchedWorkGruopAndMasterCode[i]

workMasterCodePerElement = []
familyCodePerElem = list(map(lambda x: x.Name.split('_')[0], inputElements))
for i in familyCodePerElem:
    workMasterCodePerElement.append(dic_FamilyCodeandWM[i])

materialNamePerElem = []
for i in materialPerElementFromModeling:
    tmp = []
    for j in i:
        tmp.append(j.Name)
    materialNamePerElem.append(tmp)

WMPerElementFromModeling = []
for i in materialNamePerElem:
    tmp = []
    for j in i:
        tmp.append(j.split('_')[0])
    WMPerElementFromModeling.append(tmp)

specPerElementFromModeling = []
for i in materialNamePerElem:
    tmp = []
    for j in i:
        a = j.split('_')
        del a[0]
        b = " ".join(a)
        tmp.append(b)
    specPerElementFromModeling.append(tmp)

WMPerElementFromModeling_flat = list(itertools.chain(*WMPerElementFromModeling))
specPerElementFromModeling_flat = list(itertools.chain(*specPerElementFromModeling))

dic_WMandDescription_Model = {}
for i in range(len(WMPerElementFromModeling_flat)):
    dic_WMandDescription_Model[WMPerElementFromModeling_flat[i]] = specPerElementFromModeling_flat[i]

def findAllKeys(dict):
    result = []
    for key in dict.keys():
        result.append(key)
    return result

def findAllValues(dict):
    result = []
    for key in dict.keys():
        result.append(dict[key])
    return result

keys_WMandDescription_Model = findAllKeys(dic_WMandDescription_Model)
keys_WMandDescription_Excel = findAllKeys(dic_WMandDescription_Excel)

keys_WMandDescription_Both = list(set(keys_WMandDescription_Model + keys_WMandDescription_Excel))
values_WMandDescription_Both = []
for i in keys_WMandDescription_Both:
    if i in keys_WMandDescription_Model:
        values_WMandDescription_Both.append(dic_WMandDescription_Model[i])
    else:
        values_WMandDescription_Both.append(dic_WMandDescription_Excel[i])

dic_WMandDescription_Both = {}
for i in range(len(keys_WMandDescription_Both)):
    dic_WMandDescription_Both[keys_WMandDescription_Both[i]] = values_WMandDescription_Both[i]

workMasterCodePerElementFromBoth = []
for i in range(len(workMasterCodePerElement)):
    #tmp = []
    a = WMPerElementFromModeling[i] + workMasterCodePerElement[i]
    b = findUnique(a)
    workMasterCodePerElementFromBoth.append(b)

specPerElement = []
for i in workMasterCodePerElementFromBoth:
    tmp = []
    for j in i:
        tmp.append(dic_WMandDescription_Both[j])
    specPerElement.append(tmp)

fullWMCodeDescriptionPerElement = []
for i in range(len(workMasterCodePerElementFromBoth)):
    tmp = []
    for j in range(len(workMasterCodePerElementFromBoth[i])):
        a = workMasterCodePerElementFromBoth[i][j] +": "+ specPerElement[i][j]
        tmp.append(a)
    fullWMCodeDescriptionPerElement.append(tmp)

fullWMinfo = {
"AllElement": inputElements,
"WorkMasterCodePerFamilyType": dic_FamilyCodeandWM,
"WorkMasterCodePerElementBoth": workMasterCodePerElementFromBoth,
"FullWMCodeDescriptionPerElement": fullWMCodeDescriptionPerElement
}



result = fullWMinfo

# Assign your output to the OUT variable.
OUT = result
# ----------------------------------------

# group: Organize AllElementInform AsDictionary
set_up_all_element_inform_as = Python(IN[0]=excelDataManagerNode)  # "Set Up All Element Inform as Dictionary"; CPython3
# ---------- set_up_all_element_inform_as.python (119 lines) ----------
# Load the Python Standard and DesignScript Libraries
import os
import sys
sys.path.append(os.getenv('LOCALAPPDATA').replace('\\','\\\\') + r'\Programs\Python\Python39\Lib\site-packages')
import clr
clr.AddReference('RevitAPI')
import Autodesk

clr.AddReference('ProtoGeometry')
from Autodesk.DesignScript.Geometry import *

clr.AddReference('RevitNodes')
import Revit
clr.ImportExtensions(Revit.Elements)

clr.ImportExtensions(Revit.GeometryConversion)
clr.ImportExtensions(Revit.GeometryReferences)

clr.AddReference('RevitServices')
import RevitServices
from RevitServices.Persistence import DocumentManager
from RevitServices.Transactions import TransactionManager

doc = DocumentManager.Instance.CurrentDBDocument

import random
import itertools
from functools import reduce
from collections import Iterable
import datetime
import openpyxl

def iterable(obj):
    return isinstance(obj, Iterable)

def findUnique(inputs):
    result = []
    for i in inputs:
        if i in result:
            pass
        else:
            result.append(i)
    return result

# The inputs to this node will be stored as a list in the IN variables.
dataEnteringNode = IN
inputDict = IN[0]


def importExcel(path, SheetNameIn):
    wb_obj = openpyxl.load_workbook(str(path), data_only=True)
    sheet_obj = wb_obj.get_sheet_by_name(str(SheetNameIn))

    m_row = sheet_obj.max_row
    m_col = sheet_obj.max_column

    listOut = []

    for i in range(1, m_row +1):
        listTemp = []
        for j in range(1, m_col + 1):
            cell_obj = sheet_obj.cell(row=i, column=j)
            listTemp.append(cell_obj.value)
            if len(listTemp) == m_col:
                listOut.append(listTemp)
    return listOut

def getUsedFamilyTypeOfModeling(elements):
    familyCode = list(map(lambda x: x.Name.split('_')[0], elements))
    unq_familyCode = findUnique(familyCode)
    return unq_familyCode
    
def createExcelDataDictionary(values):
    result = {}
    for i in range(len(values)):
        result[str(i)] = values[i]
    return result

def findTargetIndex(targets, list):
    result = []
    for target in targets:
        for i in range(len(list)):
            if target in str(list[i]):
                result.append(i)
            else:
                pass
    result.sort()
    return result
    
def GetValueAtKeys(keys, dictionary):
    result = [] 
    for i in keys:
        result.append(dictionary[str(i)])
    return result


# Place your code below this line
element = inputDict["AllElement"]
elementType = []
for i in element:
    elementType.append(i.Name)
familyCode = []
for i in elementType:
    familyCode.append(i.split("_")[0])
fullWMCodeDescriptionPerElement = inputDict["FullWMCodeDescriptionPerElement"]

resultDict = {
"Element": element,
"ElementType": elementType,
"FamilyCode": familyCode,
"FullWMCodeDescriptionPerElement": fullWMCodeDescriptionPerElement
}



result = resultDict

# Assign your output to the OUT variable.
OUT = result
# ----------------------------------------

# group: Select Target Family Element And Connected WorkMasters
code_block_8 = CodeBlock { 0; }
select_target_family_element_and = Python(IN[0]=set_up_all_element_inform_as, IN[1]=code_block_8)  # "Select Target Family Element And Connected WorkMasters"; CPython3
# ---------- select_target_family_element_and.python (138 lines) ----------
# Load the Python Standard and DesignScript Libraries
import os
import sys
sys.path.append(os.getenv('LOCALAPPDATA').replace('\\','\\\\') + r'\Programs\Python\Python39\Lib\site-packages')
import clr
clr.AddReference('RevitAPI')
import Autodesk

clr.AddReference('ProtoGeometry')
from Autodesk.DesignScript.Geometry import *

clr.AddReference('RevitNodes')
import Revit
clr.ImportExtensions(Revit.Elements)

clr.ImportExtensions(Revit.GeometryConversion)
clr.ImportExtensions(Revit.GeometryReferences)

clr.AddReference('RevitServices')
import RevitServices
from RevitServices.Persistence import DocumentManager
from RevitServices.Transactions import TransactionManager

doc = DocumentManager.Instance.CurrentDBDocument

import random
import itertools
from functools import reduce
from collections import Iterable
import datetime
import openpyxl

def iterable(obj):
    return isinstance(obj, Iterable)

def findUnique(inputs):
    result = []
    for i in inputs:
        if i in result:
            pass
        else:
            result.append(i)
    return result

# The inputs to this node will be stored as a list in the IN variables.
dataEnteringNode = IN
inputDict = IN[0]
inputIndex = IN[1]


def importExcel(path, SheetNameIn):
    wb_obj = openpyxl.load_workbook(str(path), data_only=True)
    sheet_obj = wb_obj.get_sheet_by_name(str(SheetNameIn))

    m_row = sheet_obj.max_row
    m_col = sheet_obj.max_column

    listOut = []

    for i in range(1, m_row +1):
        listTemp = []
        for j in range(1, m_col + 1):
            cell_obj = sheet_obj.cell(row=i, column=j)
            listTemp.append(cell_obj.value)
            if len(listTemp) == m_col:
                listOut.append(listTemp)
    return listOut

def getUsedFamilyTypeOfModeling(elements):
    familyCode = list(map(lambda x: x.Name.split('_')[0], elements))
    unq_familyCode = findUnique(familyCode)
    return unq_familyCode
    
def createExcelDataDictionary(values):
    result = {}
    for i in range(len(values)):
        result[str(i)] = values[i]
    return result

def findTargetIndex(targets, list):
    result = []
    for target in targets:
        for i in range(len(list)):
            if target in str(list[i]):
                result.append(i)
            else:
                pass
    result.sort()
    return result
    
def GetValueAtKeys(keys, dictionary):
    result = [] 
    for i in keys:
        result.append(dictionary[str(i)])
    return result


# Place your code below this line
fullWMCodeDescriptionPerElement = inputDict["FullWMCodeDescriptionPerElement"]
element = inputDict["Element"]
familyCode = inputDict["FamilyCode"]
familyCode_unique = findUnique(familyCode)
targetFamilyCode = familyCode_unique[inputIndex]
targetIndex = []
for i in range(len(familyCode)):
    if targetFamilyCode in familyCode[i]:
        targetIndex.append(i)
    else:
        pass

targetElements = []
for i in targetIndex:
    targetElements.append(element[i])

targetFamilyCode = []
for i in targetIndex:
    targetFamilyCode.append(element[i].Name)

WMforTargetElements = []
for i in targetIndex:
    WMforTargetElements.append(fullWMCodeDescriptionPerElement[i])

WMforTargetElements_flat = list(itertools.chain(*WMforTargetElements))
targetWMunique = findUnique(WMforTargetElements_flat)

resultDict = {
"TargetElements": targetElements,
"TargetFamilyCode": targetFamilyCode,
"WMforTargetElements": WMforTargetElements,
"TargetWMunique": targetWMunique
}



result = resultDict

# Assign your output to the OUT variable.
OUT = result
# ----------------------------------------

watch = Watch(select_target_family_element_and)
code_block_9 = CodeBlock(i=watch) { i; }

# group: Input Manager
value_for_import_from_others = CodeBlock(MainInput=code_block_9) { MainInput; RefInput1; RefInput2; }  # unwired: RefInput1, RefInput2

# group: <Func 10>Finishing Work Painting Work Internal Wall Painting (M2)
code_block_10 = CodeBlock { "TargetElements"; }
# note: <Func>
valueAtKey = DesignScript.Builtin.Dictionary.ValueAtKey(dictionary=value_for_import_from_others.MainInput, key=code_block_10)
geometry = Element.Geometry(element=valueAtKey)
explode = Geometry.Explode(geometry=geometry)
byJoinedSurfaces = PolySurface.ByJoinedSurfaces(surfaces=explode)
flatten = List.Flatten(list=byJoinedSurfaces)
watch_2 = Watch(flatten)
categories_2 = Categories("OST_StructuralFoundation")
all_elements_of_category_2 = ElementsOfCategory(Category=categories_2)
code_block_11 = CodeBlock { "Type"; }
getParameterValueByName = Element.GetParameterValueByName(element=all_elements_of_category_2, parameterName=code_block_11)
string_from_object = FromObject(object=getParameterValueByName)
code_block_12 = CodeBlock { "FT111"; }
contains = String.Contains(str=string_from_object, searchFor=code_block_12)
filterByBoolMask = List.FilterByBoolMask(list=all_elements_of_category_2, mask=contains)
code_block_13 = CodeBlock { "Type"; }
getParameterValueByName_2 = Element.GetParameterValueByName(element=filterByBoolMask.in, parameterName=code_block_13)
string_from_object_2 = FromObject(object=getParameterValueByName_2)
code_block_14 = CodeBlock { "PATHWAY"; }
contains_2 = String.Contains(str=string_from_object_2, searchFor=code_block_14)
filterByBoolMask_2 = List.FilterByBoolMask(list=filterByBoolMask.in, mask=contains_2)
geometry_2 = Element.Geometry(element=filterByBoolMask_2.out)
flatten_2 = List.Flatten(list=geometry_2)
byGeometry = BoundingBox.ByGeometry(geom=flatten_2)
toCuboid = BoundingBox.ToCuboid(boundingBox=byGeometry)
code_block_15 = CodeBlock(Element=toCuboid) { _Element: var[]..[]; }
code_block_16 = CodeBlock(Element=code_block_15) { _Element; }
explode_2 = Geometry.Explode(geometry=code_block_16)
explode_3 = Geometry.Explode()  # unwired: geometry
code_block_17 = CodeBlock { 0.5; }
normalAtParameter = Surface.NormalAtParameter(u=code_block_17, v=code_block_17)  # unwired: surface
function_compose = ComposeFunctions(function0=explode_3, function1=normalAtParameter)
function_apply = ApplyFunction(function=function_compose, argument0=code_block_16)
Z = Vector.Z(vector=function_apply)
code_block_18 = CodeBlock { 0; }
round = Math.Round(number=Z, digits=code_block_18)
code_block_19 = CodeBlock(i=round) { i==1; }
filterByBoolMask_3 = List.FilterByBoolMask(list=explode_2, mask=code_block_19)
perimeterCurves = Surface.PerimeterCurves(surface=filterByBoolMask_3.in)
byJoinedCurves = PolyCurve.ByJoinedCurves(curves=perimeterCurves)
code_block_20 = CodeBlock { 200; }
offset = Curve.Offset(curve=byJoinedCurves, distance=code_block_20)
categories_3 = Categories("OST_Rooms")
all_elements_of_category_3 = ElementsOfCategory(Category=categories_3)
code_block_21 = CodeBlock { "Limit Offset"; }
getParameterValueByName_3 = Element.GetParameterValueByName(element=all_elements_of_category_3, parameterName=code_block_21)
firstItem = List.FirstItem(list=getParameterValueByName_3)
translate = Geometry.Translate(geometry=offset, zTranslation=firstItem)
join_2 = List.Join(list0=offset, list1=translate)
byLoft = Solid.ByLoft(crossSections=join_2)
intersect = Geometry.Intersect(geometry=watch_2, other=byLoft)
byJoinedSurfaces_2 = PolySurface.ByJoinedSurfaces(surfaces=intersect)
categories_4 = Categories("OST_Walls")
all_elements_of_category_4 = ElementsOfCategory(Category=categories_4)
geometry_3 = Element.Geometry(element=all_elements_of_category_4)
explode_4 = Geometry.Explode(geometry=geometry_3)
flatten_3 = List.Flatten(list=explode_4)
byJoinedSurfaces_3 = PolySurface.ByJoinedSurfaces(surfaces=flatten_3)
watch_3 = Watch(byJoinedSurfaces_3)
intersect_2 = Geometry.Intersect(geometry=watch_3, other=byLoft)
byJoinedSurfaces_4 = PolySurface.ByJoinedSurfaces(surfaces=intersect_2)
difference = Surface.Difference(surface=byJoinedSurfaces_2, others=byJoinedSurfaces_4)
byPatch = Surface.ByPatch(closedCurve=offset)
difference_2 = Surface.Difference(surface=difference, others=byPatch)
code_block_22 = CodeBlock { "PolySurface"; }
removeIfNot = List.RemoveIfNot(list=difference_2, type=code_block_22)
explode_5 = Geometry.Explode(geometry=removeIfNot)
flatten_4 = List.Flatten(list=explode_5)
geometry_4 = Element.Geometry(element=all_elements_of_category_3)
flatten_5 = List.Flatten(list=geometry_4)
doesIntersect = Geometry.DoesIntersect(geometry=flatten_5, other=flatten_4, lacing=CrossProduct)
filterByBoolMask_4 = List.FilterByBoolMask(list=flatten_4, mask=doesIntersect@L2)
watch_4 = Watch(filterByBoolMask_4.in)
area = Surface.Area(surface=watch_4)
sum = Math.Sum(values=area)
code_block_23 = CodeBlock(i=sum) { Math.Round(List.Flatten(i)/1000000, 2); }
code_block_24 = CodeBlock { "M2"; }
count = List.Count(list=code_block_23)
ofRepeatedItem = List.OfRepeatedItem(item=code_block_24, amount=count)
code_block_25 = CodeBlock(FuncValues=code_block_23, FuncValuesUnit=ofRepeatedItem)
# ---------- code_block_25.designscript (4 lines) ----------
{
"FuncValues": _FuncValues,
"FuncValuesUnit": _FuncValuesUnit
};
# ----------------------------------------
color_palette = ColorPalette({R: 30, G: 144, B: 255, A: 129})
byGeometryColor = Modifiers.GeometryColor.ByGeometryColor(geometry=watch_4, color=color_palette)
color_palette_2 = ColorPalette({R: 238, G: 232, B: 170, A: 128})
byGeometryColor_2 = Modifiers.GeometryColor.ByGeometryColor(geometry=filterByBoolMask_3.in, color=color_palette_2)
watch_5 = Watch(filterByBoolMask_3.in)
pointAtParameter = Surface.PointAtParameter(surface=watch_5)

# group: Output Manager
output = CodeBlock(MainOutput=code_block_25, RefOutput_geoColor=byGeometryColor) { MainOutput; RefOutput_geoColor; }
reference_output = CodeBlock { ref; }  # unwired: ref

# group: <Func 6> Visual Manager
visual_켜기_끄기 = BoolSelector(true)
visual_manager = Python(IN[0]=output.RefOutput_geoColor, IN[1]=visual_켜기_끄기)  # CPython3
# ---------- visual_manager.python (18 lines) ----------
# Load the Python Standard and DesignScript Libraries
import sys
import clr
clr.AddReference('ProtoGeometry')
from Autodesk.DesignScript.Geometry import *

# The inputs to this node will be stored as a list in the IN variables.
dataEnteringNode = IN
geoColors = IN[0]
blnForVisual = IN[1]

# Place your code below this line
if blnForVisual == True:
    result = geoColors
else:
    result = 0
# Assign your output to the OUT variable.
OUT = result
# ----------------------------------------

# group: Ceilings 나중에 쓸 부분?
categories_5 = Categories("OST_Ceilings")
all_elements_of_category_5 = ElementsOfCategory(Category=categories_5)
extractBelowFacesOfElement = Custom[ExtractBelowFacesOfElement](Element=all_elements_of_category_5)  # ExtractBelowFacesOfElement
flatten_6 = List.Flatten(list=extractBelowFacesOfElement.Surface)
byGeometry_2 = BoundingBox.ByGeometry(geom=flatten_6)
toCuboid_2 = BoundingBox.ToCuboid(boundingBox=byGeometry_2)
explode_6 = Geometry.Explode(geometry=toCuboid_2)
pointAtParameter_2 = Surface.PointAtParameter(surface=explode_6)
Z_2 = Point.Z(point=pointAtParameter_2)

# group: Input Manager
value_for_import_from_others_2 = CodeBlock(MainInput=code_block_9) { MainInput; RefInput1; RefInput2; }  # unwired: RefInput1, RefInput2

# group: <Func 9> Finishing Work Painting Work External Wall Painting (M2)
code_block_26 = CodeBlock { "TargetElements"; }
valueAtKey_2 = DesignScript.Builtin.Dictionary.ValueAtKey(dictionary=value_for_import_from_others_2.MainInput, key=code_block_26)
extractSideFacesOfElement = Custom[ExtractSideFacesOfElement](Element=valueAtKey_2)  # ExtractSideFacesOfElement
watch_6 = Watch(extractSideFacesOfElement.Surface)
byJoinedSurfaces_5 = PolySurface.ByJoinedSurfaces(surfaces=watch_6)
geometry_5 = Element.Geometry(element=valueAtKey_2)
flatten_7 = List.Flatten(list=geometry_5)
byGeometry_3 = BoundingBox.ByGeometry(geom=flatten_7)
toCuboid_3 = BoundingBox.ToCuboid(boundingBox=byGeometry_3)
explode_7 = Geometry.Explode(geometry=toCuboid_3)
byJoinedSurfaces_6 = PolySurface.ByJoinedSurfaces(surfaces=explode_7)
intersect_3 = Geometry.Intersect(geometry=byJoinedSurfaces_5, other=byJoinedSurfaces_6)
color_palette_3 = ColorPalette({R: 30, G: 144, B: 255, A: 129})
byGeometryColor_3 = Modifiers.GeometryColor.ByGeometryColor(geometry=intersect_3, color=color_palette_3)
area_2 = Surface.Area(surface=intersect_3)
sum_2 = Math.Sum(values=area_2)
code_block_27 = CodeBlock(i=sum_2) { Math.Round(List.Flatten(i)/1000000, 2); }
code_block_28 = CodeBlock { "M2"; }
count_2 = List.Count(list=code_block_27)
ofRepeatedItem_2 = List.OfRepeatedItem(item=code_block_28, amount=count_2)
code_block_29 = CodeBlock(FuncValues=code_block_27, FuncValuesUnit=ofRepeatedItem_2)  # same code as code_block_25

# group: Output Manager
reference_output_2 = CodeBlock { ref; }  # unwired: ref
output_2 = CodeBlock(MainOutput=byGeometryColor_3) { MainOutput; RefOutput_geoColor; }  # unwired: RefOutput_geoColor

# group: <Func 6> Visual Manager
visual_켜기_끄기_2 = BoolSelector(false)
visual_manager_2 = Python(IN[0]=output_2.MainOutput, IN[1]=visual_켜기_끄기_2)  # CPython3; same code as visual_manager

# group: Input Manager
value_for_import_from_others_3 = CodeBlock(MainInput=code_block_9) { MainInput; RefInput1; RefInput2; }  # unwired: RefInput1, RefInput2

# group: <Func 00> Concrete Work Superstructure Work Structural Concrete (M3)
code_block_30 = CodeBlock { "TargetElements"; }
valueAtKey_3 = DesignScript.Builtin.Dictionary.ValueAtKey(dictionary=value_for_import_from_others_3.MainInput, key=code_block_30)
code_block_31 = CodeBlock { "Volume"; }
# note: <Func>
getParameterValueByName_4 = Element.GetParameterValueByName(element=valueAtKey_3, parameterName=code_block_31)
code_block_32 = CodeBlock(i=getParameterValueByName_4) { Math.Round(List.Flatten(i)/10000000,2); }
code_block_33 = CodeBlock { "M3"; }
count_3 = List.Count(list=code_block_32)
ofRepeatedItem_3 = List.OfRepeatedItem(item=code_block_33, amount=count_3)
code_block_34 = CodeBlock(FuncValues=code_block_32, FuncValuesUnit=ofRepeatedItem_3)  # same code as code_block_25

# group: Output Manager
output_3 = CodeBlock(MainOutput=code_block_34) { MainOutput; RefOutput_geoColor; }  # unwired: RefOutput_geoColor
reference_output_3 = CodeBlock { ref; }  # unwired: ref

# group: Input Manager
value_for_import_from_others_4 = CodeBlock(MainInput=code_block_9) { MainInput; RefInput1; RefInput2; }  # unwired: RefInput1, RefInput2

# group: <Func 00>Rebar Work (Ton)
code_block_35 = CodeBlock { "TargetElements"; }
valueAtKey_4 = DesignScript.Builtin.Dictionary.ValueAtKey(dictionary=value_for_import_from_others_4.MainInput, key=code_block_35)
code_block_36 = CodeBlock { "Volume"; }
# note: <Func>
getParameterValueByName_5 = Element.GetParameterValueByName(element=valueAtKey_4, parameterName=code_block_36)
sog_철근비 = DoubleInput(0)  # graph input
mul = getParameterValueByName_5 * sog_철근비
code_block_37 = CodeBlock(i=mul) { Math.Round(List.Flatten(i)/1, 2); }
code_block_38 = CodeBlock { "TON"; }
count_4 = List.Count(list=code_block_37)
ofRepeatedItem_4 = List.OfRepeatedItem(item=code_block_38, amount=count_4)
code_block_39 = CodeBlock(FuncValues=code_block_37, FuncValuesUnit=ofRepeatedItem_4)  # same code as code_block_25

# group: Output Manager
output_4 = CodeBlock(MainOutput=code_block_39) { MainOutput; RefOutput_geoColor; }  # unwired: RefOutput_geoColor
reference_output_4 = CodeBlock { ref; }  # unwired: ref

# group: Input Manager
value_for_import_from_others_5 = CodeBlock(MainInput=code_block_9) { MainInput; RefInput1; RefInput2; }  # unwired: RefInput1, RefInput2

# group: <Func 9> Finishing Work Painting Work External Wall Painting (M2) Floor랑 Join 메뉴얼 확인
code_block_40 = CodeBlock { "TargetElements"; }
valueAtKey_5 = DesignScript.Builtin.Dictionary.ValueAtKey(dictionary=value_for_import_from_others_5.MainInput, key=code_block_40)
extractSideFacesOfElement_2 = Custom[ExtractSideFacesOfElement](Element=valueAtKey_5)
watch_7 = Watch(extractSideFacesOfElement_2.Surface)
color_palette_4 = ColorPalette({R: 30, G: 144, B: 255, A: 129})
byGeometryColor_4 = Modifiers.GeometryColor.ByGeometryColor(geometry=watch_7, color=color_palette_4)
area_3 = Surface.Area(surface=watch_7)
sum_3 = Math.Sum(values=area_3)
code_block_41 = CodeBlock(i=sum_3) { Math.Round(List.Flatten(i)/1000000, 2); }
code_block_42 = CodeBlock { "M2"; }
count_5 = List.Count(list=code_block_41)
ofRepeatedItem_5 = List.OfRepeatedItem(item=code_block_42, amount=count_5)
code_block_43 = CodeBlock(FuncValues=code_block_41, FuncValuesUnit=ofRepeatedItem_5)  # same code as code_block_25

# group: Output Manager
output_5 = CodeBlock(MainOutput=byGeometryColor_4) { MainOutput; RefOutput_geoColor; }  # unwired: RefOutput_geoColor
reference_output_5 = CodeBlock { ref; }  # unwired: ref

# group: <Func 6> Visual Manager
visual_켜기_끄기_3 = BoolSelector(true)
visual_manager_3 = Python(IN[0]=output_5.MainOutput, IN[1]=visual_켜기_끄기_3)  # CPython3; same code as visual_manager

# group: Sample
code_block_44 = CodeBlock {  }
code_block_45 = CodeBlock {  }

# group: Primary Input
categories_6 = Categories("OST_StructuralFoundation")
all_elements_of_category_6 = ElementsOfCategory(Category=categories_6)
file_path_3 = Filename("..\BIM_물량집계 자동화 산출기준표_rC(20211029).xlsx")
file_from_path_2 = FileObject(path=file_path_3)
code_block_46 = CodeBlock { "Str Foundations"; }

# group: GetFull WMCodeDescription PerElement
code_block_47 = CodeBlock(InputElement=all_elements_of_category_6, InputFilePath=file_from_path_2, InputSheetName=code_block_46) { _InputElement; _InputFilePath; _InputSheetName; }
excelDataManagerNode_2 = Python(IN[0]=code_block_47._InputElement, IN[1]=code_block_47._InputFilePath, IN[2]=code_block_47._InputSheetName)  # CPython3; same code as excelDataManagerNode

# group: Organize AllElementInform AsDictionary
set_up_all_element_inform_as_2 = Python(IN[0]=excelDataManagerNode_2)  # "Set Up All Element Inform as Dictionary"; CPython3; same code as set_up_all_element_inform_as

# group: Select Target Family Element And Connected WorkMasters
code_block_48 = CodeBlock { 1; }
select_target_family_element_and_2 = Python(IN[0]=set_up_all_element_inform_as_2, IN[1]=code_block_48)  # "Select Target Family Element And Connected WorkMasters"; CPython3; same code as select_target_family_element_and

watch_8 = Watch(select_target_family_element_and_2)
code_block_49 = CodeBlock(i=watch_8) { i; }

# group: Input Manager
value_for_import_from_others_6 = CodeBlock(MainInput=code_block_49) { MainInput; RefInput1; RefInput2; }  # unwired: RefInput1, RefInput2

# group: <Func 9>Lean Concrete
code_block_50 = CodeBlock { "TargetElements"; }
valueAtKey_6 = DesignScript.Builtin.Dictionary.ValueAtKey(dictionary=value_for_import_from_others_6.MainInput, key=code_block_50)
code_block_51 = CodeBlock { 0; 100; }
# note: <Func>
createLeanConcrete = Custom[CreateLeanConcrete](Element=valueAtKey_6, leanOffset=code_block_51.out0, leanThick=code_block_51.out1)  # CreateLeanConcreteForISOFDN
volume = Solid.Volume(solid=createLeanConcrete.Solid)
code_block_52 = CodeBlock(i=volume) { Math.Round(List.Flatten(i)/1000000000, 2); }
code_block_53 = CodeBlock { "M3"; }
count_6 = List.Count(list=code_block_52)
ofRepeatedItem_6 = List.OfRepeatedItem(item=code_block_53, amount=count_6)
code_block_54 = CodeBlock(FuncValues=code_block_52, FuncValuesUnit=ofRepeatedItem_6)  # same code as code_block_25

# group: Output Manager
reference_output_6 = CodeBlock(ref=createLeanConcrete.Solid) { ref; }
output_6 = CodeBlock(MainOutput=code_block_54, RefOutput_geoColor=createLeanConcrete.Solid) { MainOutput; RefOutput_geoColor; }

# group: Sample
code_block_55 = CodeBlock {  }
code_block_56 = CodeBlock {  }

# group: Visual Manager
visual_켜기_끄기_4 = BoolSelector(false)
visual_manager_4 = Python(IN[0]=output_6.RefOutput_geoColor, IN[1]=visual_켜기_끄기_4)  # CPython3; same code as visual_manager

join_3 = List.Join(list0=output_6.MainOutput)  # unwired: list1, list2, list3, list4, list5, list6, list7, list8, list9, list10

# group: TargetWMunique + Data Sending
code_block_57 = CodeBlock(InputDic2=join_3) { _InputDic2; }
count_7 = List.Count(list=code_block_57)
code_block_58 = CodeBlock(InputDic1=code_block_49) { _InputDic1; }
code_block_59 = CodeBlock { "TargetWMunique"; }
valueAtKey_7 = DesignScript.Builtin.Dictionary.ValueAtKey(dictionary=code_block_58, key=code_block_59)
watch_9 = Watch(valueAtKey_7)
count_8 = List.Count(list=watch_9)
eq = count_7 == count_8
organizeFuncValuesAndWorkMasterAsDiction = Custom[OrganizeFuncValuesAndWorkMasterAsDictionary](InputDic1=code_block_58, InputDic2=code_block_57)  # Organize FuncValues and WorkMaster As Dictionary
watch_10 = Watch()  # unwired: arg0
if_ = If(test=eq, true=organizeFuncValuesAndWorkMasterAsDiction, false=watch_10)

# group: Select Target Family Element And Connected WorkMasters
# note: 설계변경으로 인한 패밀리 타입 추가 시에 패밀리 타입의 인덱스가 변화할 수 있으므로, 패밀리 타입 이름 지정으로 노드 수정이 추후 필요함
code_block_60 = CodeBlock { 1; }
select_target_family_element_and_3 = Python(IN[0]=set_up_all_element_inform_as, IN[1]=code_block_60)  # "Select Target Family Element And Connected WorkMasters"; CPython3; same code as select_target_family_element_and

watch_11 = Watch(select_target_family_element_and_3)
code_block_61 = CodeBlock(i=watch_11) { i; }

# group: Input Manager
value_for_import_from_others_7 = CodeBlock(MainInput=code_block_61) { MainInput; RefInput1; RefInput2; }  # unwired: RefInput1, RefInput2

# group: <Func 9>Lean Concrete
code_block_62 = CodeBlock { "TargetElements"; }
valueAtKey_8 = DesignScript.Builtin.Dictionary.ValueAtKey(dictionary=value_for_import_from_others_7.MainInput, key=code_block_62)
code_block_63 = CodeBlock { 0; 100; }
# note: <Func>
createLeanConcrete_2 = Custom[CreateLeanConcrete](Element=valueAtKey_8, leanOffset=code_block_63.out0, leanThick=code_block_63.out1)
volume_2 = Solid.Volume(solid=createLeanConcrete_2.Solid)
code_block_64 = CodeBlock(i=volume_2) { Math.Round(List.Flatten(i)/1000000000, 2); }
code_block_65 = CodeBlock { "M3"; }
count_9 = List.Count(list=code_block_64)
ofRepeatedItem_7 = List.OfRepeatedItem(item=code_block_65, amount=count_9)
code_block_66 = CodeBlock(FuncValues=code_block_64, FuncValuesUnit=ofRepeatedItem_7)  # same code as code_block_25

# group: Output Manager
reference_output_7 = CodeBlock(ref=createLeanConcrete_2.Solid) { ref; }
output_7 = CodeBlock(MainOutput=code_block_66, RefOutput_geoColor=createLeanConcrete_2.Solid) { MainOutput; RefOutput_geoColor; }

# group: Visual Manager
visual_켜기_끄기_5 = BoolSelector(false)
visual_manager_5 = Python(IN[0]=output_7.RefOutput_geoColor, IN[1]=visual_켜기_끄기_5)  # CPython3; same code as visual_manager

# group: Connection 확인
categories_7 = Categories("OST_StructConnections")
all_elements_of_category_7 = ElementsOfCategory(Category=categories_7)
code_block_67 = CodeBlock { "Modify Parameters"; }
getParameterValueByName_6 = Element.GetParameterValueByName(element=all_elements_of_category_7, parameterName=code_block_67)
connectionTypes = ConnectionTypes()  # nothing selected
connectionType = AdvanceSteel.ConnectionAutomation.Nodes.Connection.ConnectionType(connection=all_elements_of_category_7)
revitHandle = AdvanceSteel.ConnectionAutomation.Nodes.Connection.RevitHandle(connection=all_elements_of_category_7)
connectionName = AdvanceSteel.ConnectionAutomation.Nodes.ConnectionType.ConnectionName(connectionType=all_elements_of_category_7)
