# Dynamo graph 03 Str Column (1220).dyn (Dynamo 2.12.0.5650)

# group: export to excel
file_path = Filename("C:\Users\HEC\Desktop\11.xlsx")
code_block = CodeBlock { "Sheet1"; }
code_block_2 = CodeBlock { 1; }
code_block_3 = CodeBlock { true; }
exportExcel = Data.ExportExcel(filePath=file_path, sheetName=code_block, startRow=code_block_2, startColumn=code_block_2, overWrite=code_block_3)  # unwired: data

code_block_4 = CodeBlock { "..."; }
split = String.Split(separator0=code_block_4)  # unwired: string
code_block_5 = CodeBlock { "..."; }
split_2 = String.Split(separator0=code_block_5)  # unwired: string
join = List.Join(list0=split, list1=split_2)
code_block_6 = CodeBlock { i; }  # unwired: i

# group: Input Manager
value_for_import_from_others = CodeBlock(MainInput=code_block_6) { MainInput; RefInput1; RefInput2; }  # unwired: RefInput1, RefInput2

# group: <Func 10>Finishing Work Painting Work Internal Wall Painting (M2)
code_block_7 = CodeBlock { "TargetElements"; }
# note: <Func>
valueAtKey = DesignScript.Builtin.Dictionary.ValueAtKey(dictionary=value_for_import_from_others.MainInput, key=code_block_7)
geometry = Element.Geometry(element=valueAtKey)
explode = Geometry.Explode(geometry=geometry)
byJoinedSurfaces = PolySurface.ByJoinedSurfaces(surfaces=explode)
flatten = List.Flatten(list=byJoinedSurfaces)
watch = Watch(flatten)
categories = Categories("OST_StructuralFoundation")
all_elements_of_category = ElementsOfCategory(Category=categories)
code_block_8 = CodeBlock { "Type"; }
getParameterValueByName = Element.GetParameterValueByName(element=all_elements_of_category, parameterName=code_block_8)
string_from_object = FromObject(object=getParameterValueByName)
code_block_9 = CodeBlock { "FT111"; }
contains = String.Contains(string=string_from_object, searchFor=code_block_9)
filterByBoolMask = List.FilterByBoolMask(list=all_elements_of_category, mask=contains)
code_block_10 = CodeBlock { "Type"; }
getParameterValueByName_2 = Element.GetParameterValueByName(element=filterByBoolMask.in, parameterName=code_block_10)
string_from_object_2 = FromObject(object=getParameterValueByName_2)
code_block_11 = CodeBlock { "PATHWAY"; }
contains_2 = String.Contains(string=string_from_object_2, searchFor=code_block_11)
filterByBoolMask_2 = List.FilterByBoolMask(list=filterByBoolMask.in, mask=contains_2)
geometry_2 = Element.Geometry(element=filterByBoolMask_2.out)
flatten_2 = List.Flatten(list=geometry_2)
byGeometry = BoundingBox.ByGeometry(geom=flatten_2)
toCuboid = BoundingBox.ToCuboid(boundingBox=byGeometry)
code_block_12 = CodeBlock(Element=toCuboid) { _Element: var[]..[]; }
code_block_13 = CodeBlock(Element=code_block_12) { _Element; }
explode_2 = Geometry.Explode(geometry=code_block_13)
explode_3 = Geometry.Explode()  # unwired: geometry
code_block_14 = CodeBlock { 0.5; }
normalAtParameter = Surface.NormalAtParameter(u=code_block_14, v=code_block_14)  # unwired: surface
function_compose = ComposeFunctions(function0=explode_3, function1=normalAtParameter)
function_apply = ApplyFunction(function=function_compose, argument0=code_block_13)
Z = Vector.Z(vector=function_apply)
code_block_15 = CodeBlock { 0; }
round = Math.Round(number=Z, digits=code_block_15)
code_block_16 = CodeBlock(i=round) { i==1; }
filterByBoolMask_3 = List.FilterByBoolMask(list=explode_2, mask=code_block_16)
perimeterCurves = Surface.PerimeterCurves(surface=filterByBoolMask_3.in)
byJoinedCurves = PolyCurve.ByJoinedCurves(curves=perimeterCurves)
code_block_17 = CodeBlock { 200; }
offset = Curve.Offset(curve=byJoinedCurves, distance=code_block_17)
categories_2 = Categories("OST_Rooms")
all_elements_of_category_2 = ElementsOfCategory(Category=categories_2)
code_block_18 = CodeBlock { "Limit Offset"; }
getParameterValueByName_3 = Element.GetParameterValueByName(element=all_elements_of_category_2, parameterName=code_block_18)
firstItem = List.FirstItem(list=getParameterValueByName_3)
translate = Geometry.Translate(geometry=offset, zTranslation=firstItem)
join_2 = List.Join(list0=offset, list1=translate)
byLoft = Solid.ByLoft(crossSections=join_2)
intersect = Geometry.Intersect(geometry=watch, other=byLoft)
byJoinedSurfaces_2 = PolySurface.ByJoinedSurfaces(surfaces=intersect)
categories_3 = Categories("OST_Walls")
all_elements_of_category_3 = ElementsOfCategory(Category=categories_3)
geometry_3 = Element.Geometry(element=all_elements_of_category_3)
explode_4 = Geometry.Explode(geometry=geometry_3)
flatten_3 = List.Flatten(list=explode_4)
byJoinedSurfaces_3 = PolySurface.ByJoinedSurfaces(surfaces=flatten_3)
watch_2 = Watch(byJoinedSurfaces_3)
intersect_2 = Geometry.Intersect(geometry=watch_2, other=byLoft)
byJoinedSurfaces_4 = PolySurface.ByJoinedSurfaces(surfaces=intersect_2)
difference = Surface.Difference(surface=byJoinedSurfaces_2, others=byJoinedSurfaces_4)
byPatch = Surface.ByPatch(closedCurve=offset)
difference_2 = Surface.Difference(surface=difference, others=byPatch)
code_block_19 = CodeBlock { "PolySurface"; }
removeIfNot = List.RemoveIfNot(list=difference_2, type=code_block_19)
explode_5 = Geometry.Explode(geometry=removeIfNot)
flatten_4 = List.Flatten(list=explode_5)
geometry_4 = Element.Geometry(element=all_elements_of_category_2)
flatten_5 = List.Flatten(list=geometry_4)
doesIntersect = Geometry.DoesIntersect(geometry=flatten_5, other=flatten_4, lacing=CrossProduct)
filterByBoolMask_4 = List.FilterByBoolMask(list=flatten_4, mask=doesIntersect@L2)
watch_3 = Watch(filterByBoolMask_4.in)
area = Surface.Area(surface=watch_3)
sum = Math.Sum(values=area)
code_block_20 = CodeBlock(i=sum) { Math.Round(List.Flatten(i)/1000000, 2); }
code_block_21 = CodeBlock { "M2"; }
count = List.Count(list=code_block_20)
ofRepeatedItem = List.OfRepeatedItem(item=code_block_21, amount=count)
code_block_22 = CodeBlock(FuncValues=code_block_20, FuncValuesUnit=ofRepeatedItem)
# ---------- code_block_22.designscript (4 lines) ----------
{
"FuncValues": _FuncValues,
"FuncValuesUnit": _FuncValuesUnit
};
# ----------------------------------------
color_palette = ColorPalette({R: 30, G: 144, B: 255, A: 129})
byGeometryColor = Modifiers.GeometryColor.ByGeometryColor(geometry=watch_3, color=color_palette)
color_palette_2 = ColorPalette({R: 238, G: 232, B: 170, A: 128})
byGeometryColor_2 = Modifiers.GeometryColor.ByGeometryColor(geometry=filterByBoolMask_3.in, color=color_palette_2)
watch_4 = Watch(filterByBoolMask_3.in)
pointAtParameter = Surface.PointAtParameter(surface=watch_4)

# group: Output Manager
output = CodeBlock(MainOutput=code_block_22, RefOutput_geoColor=byGeometryColor) { MainOutput; RefOutput_geoColor; }
reference_output = CodeBlock { ref; }  # unwired: ref

# group: <Func 6> Visual Manager
visual_켜기_끄기 = BoolSelector(true)
visual_manager = Python(IN[0]=output.RefOutput_geoColor, IN[1]=visual_켜기_끄기)  # CPython3
# ---------- visual_manager.python (18 lines) ----------
# Load the Python Standard and DesignScript Libraries
import sys
import clr
clr.AddReference('ProtoGeometry')
from Autodesk.DesignScript.Geometry import *

# The inputs to this node will be stored as a list in the IN variables.
dataEnteringNode = IN
geoColors = IN[0]
blnForVisual = IN[1]

# Place your code below this line
if blnForVisual == True:
    result = geoColors
else:
    result = 0
# Assign your output to the OUT variable.
OUT = result
# ----------------------------------------

# group: Ceilings 나중에 쓸 부분?
categories_4 = Categories("OST_Ceilings")
all_elements_of_category_4 = ElementsOfCategory(Category=categories_4)
extractBelowFacesOfElement = Custom[ExtractBelowFacesOfElement](Element=all_elements_of_category_4)  # ExtractBelowFacesOfElement
flatten_6 = List.Flatten(list=extractBelowFacesOfElement.Surface)
byGeometry_2 = BoundingBox.ByGeometry(geom=flatten_6)
toCuboid_2 = BoundingBox.ToCuboid(boundingBox=byGeometry_2)
explode_6 = Geometry.Explode(geometry=toCuboid_2)
pointAtParameter_2 = Surface.PointAtParameter(surface=explode_6)
Z_2 = Point.Z(point=pointAtParameter_2)

# group: Primary Input : Excel & Revit Elements
categories_5 = Categories("OST_StructuralColumns")
all_elements_of_category_5 = ElementsOfCategory(Category=categories_5)
string_from_web = Python()  # CPython3; unwired: IN[0]
# ---------- string_from_web.python (19 lines) ----------
# Load the Python Standard and DesignScript Libraries
import sys
import clr
clr.AddReference('ProtoGeometry')
from Autodesk.DesignScript.Geometry import *
import urllib.request

# The inputs to this node will be stored as a list in the IN variables.
dataEnteringNode = IN
inputURL = "https://raw.githubusercontent.com/HNANmal/mQ/master/Hdynlib/General/ImportExcel.py"

# Place your code below this line
req = urllib.request
data = req.urlopen(inputURL)

result = data.read().decode("utf-8")

# Assign your output to the OUT variable.
OUT = result
# ----------------------------------------
file_path_2 = Filename(".\BIM_물량집계 자동화 산출기준표_rC(20211207)_강한호 (1).xlsx")  # graph input
sheet_name = CodeBlock { "Str Columns"; }
github_python_import_excel_by = PythonStringNode(script=string_from_web, IN[0]=file_path_2, IN[1]=sheet_name)  # "Github_Python@Import Excel(By OpenpyXl)"; CPython3
code_block_23 = CodeBlock(InputElement=all_elements_of_category_5, InputData=github_python_import_excel_by) { _InputElement; _InputData; }

# group: GetFull WMCodeDescription PerElement
excelDataManagerNode = Python(IN[0]=code_block_23._InputElement, IN[1]=code_block_23._InputData)  # CPython3
# ---------- excelDataManagerNode.python (279 lines) ----------
# Load the Python Standard and DesignScript Libraries
import os
import sys
sys.path.append(os.getenv('LOCALAPPDATA').replace('\\','\\\\') + r'\Programs\Python\Python39\Lib\site-packages')
import clr
clr.AddReference('RevitAPI')
import Autodesk

clr.AddReference('ProtoGeometry')
from Autodesk.DesignScript.Geometry import *

clr.AddReference('RevitNodes')
import Revit
clr.ImportExtensions(Revit.Elements)

clr.ImportExtensions(Revit.GeometryConversion)
clr.ImportExtensions(Revit.GeometryReferences)

clr.AddReference('RevitServices')
import RevitServices
from RevitServices.Persistence import DocumentManager
from RevitServices.Transactions import TransactionManager

doc = DocumentManager.Instance.CurrentDBDocument

import random
import itertools
from functools import reduce
from collections import Iterable
import datetime
import openpyxl

def iterable(obj):
    return isinstance(obj, Iterable)

def findUnique(inputs):
    result = []
    for i in inputs:
        if i in result:
            pass
        else:
            result.append(i)
    return result

# The inputs to this node will be stored as a list in the IN variables.
dataEnteringNode = IN
inputElements = IN[0]
inputData = IN[1]
#inputSheetName = IN[2]

def importExcel(path, SheetNameIn):
    wb_obj = openpyxl.load_workbook(str(path), data_only=True)
    sheet_obj = wb_obj.get_sheet_by_name(str(SheetNameIn))

    m_row = sheet_obj.max_row
    m_col = sheet_obj.max_column

    listOut = []

    for i in range(1, m_row +1):
        listTemp = []
        for j in range(1, m_col + 1):
            cell_obj = sheet_obj.cell(row=i, column=j)
            listTemp.append(cell_obj.value)
            if len(listTemp) == m_col:
                listOut.append(listTemp)
    return listOut

def getUsedFamilyTypeOfModeling(elements):
    familyCode = list(map(lambda x: x.Name.split('_')[0], elements))
    unq_familyCode = findUnique(familyCode)
    return unq_familyCode
    
def createExcelDataDictionary(values):
    result = {}
    for i in range(len(values)):
        result[str(i)] = values[i]
    return result

def findTargetIndex(targets, list):
    result = []
    for target in targets:
        for i in range(len(list)):
            if target in str(list[i]):
                result.append(i)
            else:
                pass
    result.sort()
    return result
    
def GetValueAtKeys(keys, dictionary):
    result = [] 
    for i in keys:
        result.append(dictionary[str(i)])
    return result


# Place your code below this line
usedFamilyTypeOfModeling = getUsedFamilyTypeOfModeling(inputElements)
excelWholeDataSet = inputData#importExcel(inputFilePath, inputSheetName)
trExcelWholeDataSet = list(zip(*excelWholeDataSet))
excelColumnDataSet = createExcelDataDictionary(trExcelWholeDataSet)
excelRowDataSet = createExcelDataDictionary(excelWholeDataSet)
ColumnIndexOfUsedFamilyType = findTargetIndex(usedFamilyTypeOfModeling, trExcelWholeDataSet)
ColDataSetOfUsedFamilyType = GetValueAtKeys(ColumnIndexOfUsedFamilyType, excelColumnDataSet)
materialPerElementFromModeling = []
for i in inputElements:
    materialPerElementFromModeling.append(i.GetMaterials())
#list(map(lambda x: x.GetMaterials, inputElements)) "맵함수로 처리하면 리스트화 할 때 타입 변환 오류 남"

targetWMRowIndex = []
for i in ColDataSetOfUsedFamilyType:
    targetWMRowIndex.append(findTargetIndex(['000'], i))

rowDataSetOfUsedWM = []
for i in targetWMRowIndex:
    rowDataSetOfUsedWM.append(GetValueAtKeys(i, excelRowDataSet))

workGroup = []
for i in rowDataSetOfUsedWM:
    tmp = []
    for j in i:
        tmp.append(j[0])
    workGroup.append(tmp)
    
workMaster = []
for i in range(len(ColDataSetOfUsedFamilyType)):
    tmp=[]
    for k in targetWMRowIndex[i]:
        tmp.append(ColDataSetOfUsedFamilyType[i][k])
    workMaster.append(tmp)

matchedWM = []
for i in range(len(workGroup)):
    tmp = []
    for j in range(len(workGroup[i])):
        fullWM = workGroup[i][j] +"-"+ workMaster[i][j]
        tmp.append(fullWM)
    matchedWM.append(tmp)

matchedWorkGruopAndMasterCode = []
for i in matchedWM:
    if len(i) > 0:
        matchedWorkGruopAndMasterCode.append(i)
    else:
        pass

matchedWMDescription = []
for i in rowDataSetOfUsedWM:
    tmp=[]
    for j in i:
        tmp.append(j[1] +" "+ j[2] +" "+ j[3] +" "+ "("+ j[4] +")")
    if len(tmp) > 0:
        matchedWMDescription.append(tmp)
    else:
        pass

matchedWMUnit = []
for i in rowDataSetOfUsedWM:
    tmp=[]
    for j in i:
        tmp.append(j[4])
    if len(tmp) > 0:
        matchedWMUnit.append(tmp)
    else:
        pass

matchedWorkGruopAndMasterCode_flat = list(itertools.chain(*matchedWorkGruopAndMasterCode))
matchedWMDescription_flat = list(itertools.chain(*matchedWMDescription))

dic_WMandDescription_Excel = {}
for i in range(len(matchedWorkGruopAndMasterCode_flat)):
    dic_WMandDescription_Excel[matchedWorkGruopAndMasterCode_flat[i]] = matchedWMDescription_flat[i]

usedFamilyTypeInExcelOrder = list(map(lambda x: x[3], ColDataSetOfUsedFamilyType))
usedFamilyCodeInExcelOrder = findUnique(list(map(lambda x: x.split('_')[0], usedFamilyTypeInExcelOrder)))

dic_FamilyCodeandWM = {}
for i in range(len(usedFamilyCodeInExcelOrder)):
    dic_FamilyCodeandWM[usedFamilyCodeInExcelOrder[i]] = matchedWorkGruopAndMasterCode[i]

workMasterCodePerElement = []
familyCodePerElem = list(map(lambda x: x.Name.split('_')[0], inputElements))
for i in familyCodePerElem:
    workMasterCodePerElement.append(dic_FamilyCodeandWM[i])

materialNamePerElem = []
for i in materialPerElementFromModeling:
    tmp = []
    for j in i:
        tmp.append(j.Name)
    materialNamePerElem.append(tmp)

WMPerElementFromModeling = []
for i in materialNamePerElem:
    tmp = []
    for j in i:
        tmp.append(j.split('_')[0])
    WMPerElementFromModeling.append(tmp)

specPerElementFromModeling = []
for i in materialNamePerElem:
    tmp = []
    for j in i:
        a = j.split('_')
        del a[0]
        b = " ".join(a)
        tmp.append(b)
    specPerElementFromModeling.append(tmp)

WMPerElementFromModeling_flat = list(itertools.chain(*WMPerElementFromModeling))
specPerElementFromModeling_flat = list(itertools.chain(*specPerElementFromModeling))

dic_WMandDescription_Model = {}
for i in range(len(WMPerElementFromModeling_flat)):
    dic_WMandDescription_Model[WMPerElementFromModeling_flat[i]] = specPerElementFromModeling_flat[i]

def findAllKeys(dict):
    result = []
    for key in dict.keys():
        result.append(key)
    return result

def findAllValues(dict):
    result = []
    for key in dict.keys():
        result.append(dict[key])
    return result

keys_WMandDescription_Model = findAllKeys(dic_WMandDescription_Model)
keys_WMandDescription_Excel = findAllKeys(dic_WMandDescription_Excel)

keys_WMandDescription_Both = list(set(keys_WMandDescription_Model + keys_WMandDescription_Excel))
values_WMandDescription_Both = []
for i in keys_WMandDescription_Both:
    if i in keys_WMandDescription_Model:
        values_WMandDescription_Both.append(dic_WMandDescription_Model[i])
    else:
        values_WMandDescription_Both.append(dic_WMandDescription_Excel[i])

dic_WMandDescription_Both = {}
for i in range(len(keys_WMandDescription_Both)):
    dic_WMandDescription_Both[keys_WMandDescription_Both[i]] = values_WMandDescription_Both[i]

workMasterCodePerElementFromBoth = []
for i in range(len(workMasterCodePerElement)):
    #tmp = []
    a = WMPerElementFromModeling[i] + workMasterCodePerElement[i]
    b = findUnique(a)
    workMasterCodePerElementFromBoth.append(b)

specPerElement = []
for i in workMasterCodePerElementFromBoth:
    tmp = []
    for j in i:
        tmp.append(dic_WMandDescription_Both[j])
    specPerElement.append(tmp)

fullWMCodeDescriptionPerElement = []
for i in range(len(workMasterCodePerElementFromBoth)):
    tmp = []
    for j in range(len(workMasterCodePerElementFromBoth[i])):
        a = workMasterCodePerElementFromBoth[i][j] +": "+ specPerElement[i][j]
        tmp.append(a)
    fullWMCodeDescriptionPerElement.append(tmp)

fullWMinfo = {
"AllElement": inputElements,
"WorkMasterCodePerFamilyType": dic_FamilyCodeandWM,
"WorkMasterCodePerElementBoth": workMasterCodePerElementFromBoth,
"FullWMCodeDescriptionPerElement": fullWMCodeDescriptionPerElement
}



result = fullWMinfo

# Assign your output to the OUT variable.
OUT = result
# ----------------------------------------

# group: Organize AllElementInform AsDictionary
set_up_all_element_inform_as = Python(IN[0]=excelDataManagerNode)  # "Set Up All Element Inform as Dictionary"; CPython3
# ---------- set_up_all_element_inform_as.python (119 lines) ----------
# Load the Python Standard and DesignScript Libraries
import os
import sys
sys.path.append(os.getenv('LOCALAPPDATA').replace('\\','\\\\') + r'\Programs\Python\Python39\Lib\site-packages')
import clr
clr.AddReference('RevitAPI')
import Autodesk

clr.AddReference('ProtoGeometry')
from Autodesk.DesignScript.Geometry import *

clr.AddReference('RevitNodes')
import Revit
clr.ImportExtensions(Revit.Elements)

clr.ImportExtensions(Revit.GeometryConversion)
clr.ImportExtensions(Revit.GeometryReferences)

clr.AddReference('RevitServices')
import RevitServices
from RevitServices.Persistence import DocumentManager
from RevitServices.Transactions import TransactionManager

doc = DocumentManager.Instance.CurrentDBDocument

import random
import itertools
from functools import reduce
from collections import Iterable
import datetime
import openpyxl

def iterable(obj):
    return isinstance(obj, Iterable)

def findUnique(inputs):
    result = []
    for i in inputs:
        if i in result:
            pass
        else:
            result.append(i)
    return result

# The inputs to this node will be stored as a list in the IN variables.
dataEnteringNode = IN
inputDict = IN[0]


def importExcel(path, SheetNameIn):
    wb_obj = openpyxl.load_workbook(str(path), data_only=True)
    sheet_obj = wb_obj.get_sheet_by_name(str(SheetNameIn))

    m_row = sheet_obj.max_row
    m_col = sheet_obj.max_column

    listOut = []

    for i in range(1, m_row +1):
        listTemp = []
        for j in range(1, m_col + 1):
            cell_obj = sheet_obj.cell(row=i, column=j)
            listTemp.append(cell_obj.value)
            if len(listTemp) == m_col:
                listOut.append(listTemp)
    return listOut

def getUsedFamilyTypeOfModeling(elements):
    familyCode = list(map(lambda x: x.Name.split('_')[0], elements))
    unq_familyCode = findUnique(familyCode)
    return unq_familyCode
    
def createExcelDataDictionary(values):
    result = {}
    for i in range(len(values)):
        result[str(i)] = values[i]
    return result

def findTargetIndex(targets, list):
    result = []
    for target in targets:
        for i in range(len(list)):
            if target in str(list[i]):
                result.append(i)
            else:
                pass
    result.sort()
    return result
    
def GetValueAtKeys(keys, dictionary):
    result = [] 
    for i in keys:
        result.append(dictionary[str(i)])
    return result


# Place your code below this line
element = inputDict["AllElement"]
elementType = []
for i in element:
    elementType.append(i.Name)
familyCode = []
for i in elementType:
    familyCode.append(i.split("_")[0])
fullWMCodeDescriptionPerElement = inputDict["FullWMCodeDescriptionPerElement"]

resultDict = {
"Element": element,
"ElementType": elementType,
"FamilyCode": familyCode,
"FullWMCodeDescriptionPerElement": fullWMCodeDescriptionPerElement
}



result = resultDict

# Assign your output to the OUT variable.
OUT = result
# ----------------------------------------

# group: Select Target Family Element And Connected WorkMasters
code_block_24 = CodeBlock { 0; }
select_target_family_element_and = Python(IN[0]=set_up_all_element_inform_as, IN[1]=code_block_24)  # "Select Target Family Element And Connected WorkMasters"; CPython3
# ---------- select_target_family_element_and.python (138 lines) ----------
# Load the Python Standard and DesignScript Libraries
import os
import sys
sys.path.append(os.getenv('LOCALAPPDATA').replace('\\','\\\\') + r'\Programs\Python\Python39\Lib\site-packages')
import clr
clr.AddReference('RevitAPI')
import Autodesk

clr.AddReference('ProtoGeometry')
from Autodesk.DesignScript.Geometry import *

clr.AddReference('RevitNodes')
import Revit
clr.ImportExtensions(Revit.Elements)

clr.ImportExtensions(Revit.GeometryConversion)
clr.ImportExtensions(Revit.GeometryReferences)

clr.AddReference('RevitServices')
import RevitServices
from RevitServices.Persistence import DocumentManager
from RevitServices.Transactions import TransactionManager

doc = DocumentManager.Instance.CurrentDBDocument

import random
import itertools
from functools import reduce
from collections import Iterable
import datetime
import openpyxl

def iterable(obj):
    return isinstance(obj, Iterable)

def findUnique(inputs):
    result = []
    for i in inputs:
        if i in result:
            pass
        else:
            result.append(i)
    return result

# The inputs to this node will be stored as a list in the IN variables.
dataEnteringNode = IN
inputDict = IN[0]
inputIndex = IN[1]


def importExcel(path, SheetNameIn):
    wb_obj = openpyxl.load_workbook(str(path), data_only=True)
    sheet_obj = wb_obj.get_sheet_by_name(str(SheetNameIn))

    m_row = sheet_obj.max_row
    m_col = sheet_obj.max_column

    listOut = []

    for i in range(1, m_row +1):
        listTemp = []
        for j in range(1, m_col + 1):
            cell_obj = sheet_obj.cell(row=i, column=j)
            listTemp.append(cell_obj.value)
            if len(listTemp) == m_col:
                listOut.append(listTemp)
    return listOut

def getUsedFamilyTypeOfModeling(elements):
    familyCode = list(map(lambda x: x.Name.split('_')[0], elements))
    unq_familyCode = findUnique(familyCode)
    return unq_familyCode
    
def createExcelDataDictionary(values):
    result = {}
    for i in range(len(values)):
        result[str(i)] = values[i]
    return result

def findTargetIndex(targets, list):
    result = []
    for target in targets:
        for i in range(len(list)):
            if target in str(list[i]):
                result.append(i)
            else:
                pass
    result.sort()
    return result
    
def GetValueAtKeys(keys, dictionary):
    result = [] 
    for i in keys:
        result.append(dictionary[str(i)])
    return result


# Place your code below this line
fullWMCodeDescriptionPerElement = inputDict["FullWMCodeDescriptionPerElement"]
element = inputDict["Element"]
familyCode = inputDict["FamilyCode"]
familyCode_unique = findUnique(familyCode)
targetFamilyCode = familyCode_unique[inputIndex]
targetIndex = []
for i in range(len(familyCode)):
    if targetFamilyCode in familyCode[i]:
        targetIndex.append(i)
    else:
        pass

targetElements = []
for i in targetIndex:
    targetElements.append(element[i])

targetFamilyCode = []
for i in targetIndex:
    targetFamilyCode.append(element[i].Name)

WMforTargetElements = []
for i in targetIndex:
    WMforTargetElements.append(fullWMCodeDescriptionPerElement[i])

WMforTargetElements_flat = list(itertools.chain(*WMforTargetElements))
targetWMunique = findUnique(WMforTargetElements_flat)

resultDict = {
"TargetElements": targetElements,
"TargetFamilyCode": targetFamilyCode,
"WMforTargetElements": WMforTargetElements,
"TargetWMunique": targetWMunique
}



result = resultDict

# Assign your output to the OUT variable.
OUT = result
# ----------------------------------------

watch_5 = Watch(select_target_family_element_and)

# group: Input Manager
value_for_import_from_others_2 = CodeBlock(MainInput=code_block_6) { MainInput; RefInput1; RefInput2; }  # unwired: RefInput1, RefInput2

# group: <Func 9> Finishing Work Painting Work External Wall Painting (M2)
code_block_25 = CodeBlock { "TargetElements"; }
valueAtKey_2 = DesignScript.Builtin.Dictionary.ValueAtKey(dictionary=value_for_import_from_others_2.MainInput, key=code_block_25)
extractSideFacesOfElement = Custom[ExtractSideFacesOfElement](Element=valueAtKey_2)  # ExtractSideFacesOfElement
watch_6 = Watch(extractSideFacesOfElement.Surface)
byJoinedSurfaces_5 = PolySurface.ByJoinedSurfaces(surfaces=watch_6)
geometry_5 = Element.Geometry(element=valueAtKey_2)
flatten_7 = List.Flatten(list=geometry_5)
byGeometry_3 = BoundingBox.ByGeometry(geom=flatten_7)
toCuboid_3 = BoundingBox.ToCuboid(boundingBox=byGeometry_3)
explode_7 = Geometry.Explode(geometry=toCuboid_3)
byJoinedSurfaces_6 = PolySurface.ByJoinedSurfaces(surfaces=explode_7)
intersect_3 = Geometry.Intersect(geometry=byJoinedSurfaces_5, other=byJoinedSurfaces_6)
color_palette_3 = ColorPalette({R: 30, G: 144, B: 255, A: 129})
byGeometryColor_3 = Modifiers.GeometryColor.ByGeometryColor(geometry=intersect_3, color=color_palette_3)
area_2 = Surface.Area(surface=intersect_3)
sum_2 = Math.Sum(values=area_2)
code_block_26 = CodeBlock(i=sum_2) { Math.Round(List.Flatten(i)/1000000, 2); }
code_block_27 = CodeBlock { "M2"; }
count_2 = List.Count(list=code_block_26)
ofRepeatedItem_2 = List.OfRepeatedItem(item=code_block_27, amount=count_2)
code_block_28 = CodeBlock(FuncValues=code_block_26, FuncValuesUnit=ofRepeatedItem_2)  # same code as code_block_22

# group: Output Manager
reference_output_2 = CodeBlock { ref; }  # unwired: ref
output_2 = CodeBlock(MainOutput=byGeometryColor_3) { MainOutput; RefOutput_geoColor; }  # unwired: RefOutput_geoColor

# group: <Func 6> Visual Manager
visual_켜기_끄기_2 = BoolSelector(true)
visual_manager_2 = Python(IN[0]=output_2.MainOutput, IN[1]=visual_켜기_끄기_2)  # CPython3; same code as visual_manager

# group: Input Manager
value_for_import_from_others_3 = CodeBlock(MainInput=code_block_6) { MainInput; RefInput1; RefInput2; }  # unwired: RefInput1, RefInput2

# group: <Func 00> Concrete Work Superstructure Work Structural Concrete (M3)
code_block_29 = CodeBlock { "TargetElements"; }
valueAtKey_3 = DesignScript.Builtin.Dictionary.ValueAtKey(dictionary=value_for_import_from_others_3.MainInput, key=code_block_29)
code_block_30 = CodeBlock { "Volume"; }
# note: <Func>
getParameterValueByName_4 = Element.GetParameterValueByName(element=valueAtKey_3, parameterName=code_block_30)
code_block_31 = CodeBlock(i=getParameterValueByName_4) { Math.Round(List.Flatten(i)/10000000,2); }
code_block_32 = CodeBlock { "M3"; }
count_3 = List.Count(list=code_block_31)
ofRepeatedItem_3 = List.OfRepeatedItem(item=code_block_32, amount=count_3)
code_block_33 = CodeBlock(FuncValues=code_block_31, FuncValuesUnit=ofRepeatedItem_3)  # same code as code_block_22

# group: Output Manager
output_3 = CodeBlock(MainOutput=code_block_33) { MainOutput; RefOutput_geoColor; }  # unwired: RefOutput_geoColor
reference_output_3 = CodeBlock { ref; }  # unwired: ref

# group: Input Manager
value_for_import_from_others_4 = CodeBlock(MainInput=code_block_6) { MainInput; RefInput1; RefInput2; }  # unwired: RefInput1, RefInput2

# group: <Func 00>Rebar Work (Ton)
code_block_34 = CodeBlock { "TargetElements"; }
valueAtKey_4 = DesignScript.Builtin.Dictionary.ValueAtKey(dictionary=value_for_import_from_others_4.MainInput, key=code_block_34)
code_block_35 = CodeBlock { "Volume"; }
# note: <Func>
getParameterValueByName_5 = Element.GetParameterValueByName(element=valueAtKey_4, parameterName=code_block_35)
sog_철근비 = DoubleInput(0)  # graph input
mul = getParameterValueByName_5 * sog_철근비
code_block_36 = CodeBlock(i=mul) { Math.Round(List.Flatten(i)/1, 2); }
code_block_37 = CodeBlock { "TON"; }
count_4 = List.Count(list=code_block_36)
ofRepeatedItem_4 = List.OfRepeatedItem(item=code_block_37, amount=count_4)
code_block_38 = CodeBlock(FuncValues=code_block_36, FuncValuesUnit=ofRepeatedItem_4)  # same code as code_block_22

# group: Output Manager
output_4 = CodeBlock(MainOutput=code_block_38) { MainOutput; RefOutput_geoColor; }  # unwired: RefOutput_geoColor
reference_output_4 = CodeBlock { ref; }  # unwired: ref

# group: Input Manager
value_for_import_from_others_5 = CodeBlock(MainInput=code_block_6) { MainInput; RefInput1; RefInput2; }  # unwired: RefInput1, RefInput2

# group: <Func 9> Finishing Work Painting Work External Wall Painting (M2) Floor랑 Join 메뉴얼 확인
code_block_39 = CodeBlock { "TargetElements"; }
valueAtKey_5 = DesignScript.Builtin.Dictionary.ValueAtKey(dictionary=value_for_import_from_others_5.MainInput, key=code_block_39)
extractSideFacesOfElement_2 = Custom[ExtractSideFacesOfElement](Element=valueAtKey_5)
watch_7 = Watch(extractSideFacesOfElement_2.Surface)
color_palette_4 = ColorPalette({R: 30, G: 144, B: 255, A: 129})
byGeometryColor_4 = Modifiers.GeometryColor.ByGeometryColor(geometry=watch_7, color=color_palette_4)
area_3 = Surface.Area(surface=watch_7)
sum_3 = Math.Sum(values=area_3)
code_block_40 = CodeBlock(i=sum_3) { Math.Round(List.Flatten(i)/1000000, 2); }
code_block_41 = CodeBlock { "M2"; }
count_5 = List.Count(list=code_block_40)
ofRepeatedItem_5 = List.OfRepeatedItem(item=code_block_41, amount=count_5)
code_block_42 = CodeBlock(FuncValues=code_block_40, FuncValuesUnit=ofRepeatedItem_5)  # same code as code_block_22

# group: Output Manager
output_5 = CodeBlock(MainOutput=byGeometryColor_4) { MainOutput; RefOutput_geoColor; }  # unwired: RefOutput_geoColor
reference_output_5 = CodeBlock { ref; }  # unwired: ref

# group: <Func 6> Visual Manager
visual_켜기_끄기_3 = BoolSelector(true)
visual_manager_3 = Python(IN[0]=output_5.MainOutput, IN[1]=visual_켜기_끄기_3)  # CPython3; same code as visual_manager

# group: Select Target Family Element And Connected WorkMasters
# note: 설계변경으로 인한 패밀리 타입 추가 시에 패밀리 타입의 인덱스가 변화할 수 있으므로, 패밀리 타입 이름 지정으로 노드 수정이 추후 필요함
code_block_43 = CodeBlock { 1; }
select_target_family_element_and_2 = Python(IN[0]=set_up_all_element_inform_as, IN[1]=code_block_43)  # "Select Target Family Element And Connected WorkMasters"; CPython3; same code as select_target_family_element_and

watch_8 = Watch(select_target_family_element_and_2)
code_block_44 = CodeBlock { i; }  # unwired: i

# group: Input Manager
value_for_import_from_others_6 = CodeBlock(MainInput=code_block_44) { MainInput; RefInput1; RefInput2; }  # unwired: RefInput1, RefInput2

# group: <Func 9>Lean Concrete
code_block_45 = CodeBlock { "TargetElements"; }
valueAtKey_6 = DesignScript.Builtin.Dictionary.ValueAtKey(dictionary=value_for_import_from_others_6.MainInput, key=code_block_45)
code_block_46 = CodeBlock { 0; 100; }
# note: <Func>
createLeanConcrete = Custom[CreateLeanConcrete](Element=valueAtKey_6, leanOffset=code_block_46.out0, leanThick=code_block_46.out1)  # CreateLeanConcreteForISOFDN
volume = Solid.Volume(solid=createLeanConcrete.Solid)
code_block_47 = CodeBlock(i=volume) { Math.Round(List.Flatten(i)/1000000000, 2); }
code_block_48 = CodeBlock { "M3"; }
count_6 = List.Count(list=code_block_47)
ofRepeatedItem_6 = List.OfRepeatedItem(item=code_block_48, amount=count_6)
code_block_49 = CodeBlock(FuncValues=code_block_47, FuncValuesUnit=ofRepeatedItem_6)  # same code as code_block_22

# group: Output Manager
reference_output_6 = CodeBlock(ref=createLeanConcrete.Solid) { ref; }
output_6 = CodeBlock(MainOutput=code_block_49, RefOutput_geoColor=createLeanConcrete.Solid) { MainOutput; RefOutput_geoColor; }

# group: Visual Manager
visual_켜기_끄기_4 = BoolSelector(true)
visual_manager_4 = Python(IN[0]=output_6.RefOutput_geoColor, IN[1]=visual_켜기_끄기_4)  # CPython3; same code as visual_manager

# group: Connection 확인
categories_6 = Categories("OST_StructConnections")
all_elements_of_category_6 = ElementsOfCategory(Category=categories_6)
code_block_50 = CodeBlock { "Modify Parameters"; }
getParameterValueByName_6 = Element.GetParameterValueByName(element=all_elements_of_category_6, parameterName=code_block_50)
connectionTypes = ConnectionTypes()  # nothing selected
connectionType = AdvanceSteel.ConnectionAutomation.Nodes.Connection.ConnectionType(connection=all_elements_of_category_6)
revitHandle = AdvanceSteel.ConnectionAutomation.Nodes.Connection.RevitHandle(connection=all_elements_of_category_6)
connectionName = AdvanceSteel.ConnectionAutomation.Nodes.ConnectionType.ConnectionName(connectionType=all_elements_of_category_6)

# group: Select Target Family Element And Connected WorkMasters
# note: 설계변경으로 인한 패밀리 타입 추가 시에 패밀리 타입의 인덱스가 변화할 수 있으므로, 패밀리 타입 이름 지정으로 노드 수정이 추후 필요함
code_block_51 = CodeBlock { 2; }
select_target_family_element_and_3 = Python(IN[0]=set_up_all_element_inform_as, IN[1]=code_block_51)  # "Select Target Family Element And Connected WorkMasters"; CPython3; same code as select_target_family_element_and

watch_9 = Watch(select_target_family_element_and_3)

# group: Output Manager
output_7 = CodeBlock { MainOutput; RefOutput_geoColor; }  # unwired: MainOutput, RefOutput_geoColor
reference_output_7 = CodeBlock { ref; }  # unwired: ref

# group: Visual Manager
visual_켜기_끄기_5 = BoolSelector(false)
visual_manager_5 = Python(IN[0]=output_7.RefOutput_geoColor, IN[1]=visual_켜기_끄기_5)  # CPython3; same code as visual_manager

# group: Output Manager
output_8 = CodeBlock { MainOutput; RefOutput_geoColor; }  # unwired: MainOutput, RefOutput_geoColor
reference_output_8 = CodeBlock { ref; }  # unwired: ref

# group: Visual Manager
visual_켜기_끄기_6 = BoolSelector(false)
visual_manager_6 = Python(IN[0]=output_8.RefOutput_geoColor, IN[1]=visual_켜기_끄기_6)  # CPython3; same code as visual_manager

# group: Output Manager
output_9 = CodeBlock { MainOutput; RefOutput_geoColor; }  # unwired: MainOutput, RefOutput_geoColor
reference_output_9 = CodeBlock { ref; }  # unwired: ref

# group: Visual Manager
visual_켜기_끄기_7 = BoolSelector(false)
visual_manager_7 = Python(IN[0]=output_9.RefOutput_geoColor, IN[1]=visual_켜기_끄기_7)  # CPython3; same code as visual_manager

# group: Output Manager
output_10 = CodeBlock { MainOutput; RefOutput_geoColor; }  # unwired: MainOutput, RefOutput_geoColor
reference_output_10 = CodeBlock { ref; }  # unwired: ref

# group: Visual Manager
visual_켜기_끄기_8 = BoolSelector(false)
visual_manager_8 = Python(IN[0]=output_10.RefOutput_geoColor, IN[1]=visual_켜기_끄기_8)  # CPython3; same code as visual_manager

# group: Output Manager
output_11 = CodeBlock { MainOutput; RefOutput_geoColor; }  # unwired: MainOutput, RefOutput_geoColor
reference_output_11 = CodeBlock { ref; }  # unwired: ref

# group: Visual Manager
visual_켜기_끄기_9 = BoolSelector(false)
visual_manager_9 = Python(IN[0]=output_11.RefOutput_geoColor, IN[1]=visual_켜기_끄기_9)  # CPython3; same code as visual_manager

# group: Output Manager
output_12 = CodeBlock { MainOutput; RefOutput_geoColor; }  # unwired: MainOutput, RefOutput_geoColor
reference_output_12 = CodeBlock { ref; }  # unwired: ref

# group: Visual Manager
visual_켜기_끄기_10 = BoolSelector(false)
visual_manager_10 = Python(IN[0]=output_12.RefOutput_geoColor, IN[1]=visual_켜기_끄기_10)  # CPython3; same code as visual_manager

# group: Output Manager
output_13 = CodeBlock { MainOutput; RefOutput_geoColor; }  # unwired: MainOutput, RefOutput_geoColor
reference_output_13 = CodeBlock { ref; }  # unwired: ref

# group: Visual Manager
visual_켜기_끄기_11 = BoolSelector(false)
visual_manager_11 = Python(IN[0]=output_13.RefOutput_geoColor, IN[1]=visual_켜기_끄기_11)  # CPython3; same code as visual_manager

code_block_52 = CodeBlock { i; }  # unwired: i

# group: Input Manager
value_for_import_from_others_7 = CodeBlock(MainInput=code_block_52) { MainInput; RefInput1; RefInput2; }  # unwired: RefInput1, RefInput2

# group: <Func 7>Screed
code_block_53 = CodeBlock { "TargetElements"; }
# note: <Func>
valueAtKey_7 = DesignScript.Builtin.Dictionary.ValueAtKey(dictionary=value_for_import_from_others_7.MainInput, key=code_block_53)

# group: Input Manager
value_for_import_from_others_8 = CodeBlock(MainInput=code_block_52) { MainInput; RefInput1; RefInput2; }  # unwired: RefInput1, RefInput2

# group: <Func 6>Skirt Painting
code_block_54 = CodeBlock { "TargetElements"; }
# note: <Func>
valueAtKey_8 = DesignScript.Builtin.Dictionary.ValueAtKey(dictionary=value_for_import_from_others_8.MainInput, key=code_block_54)

# group: Input Manager
value_for_import_from_others_9 = CodeBlock(MainInput=code_block_52) { MainInput; RefInput1; RefInput2; }  # unwired: RefInput1, RefInput2

# group: <Func 5> Floor Painting
code_block_55 = CodeBlock { "TargetElements"; }
# note: <Func>
valueAtKey_9 = DesignScript.Builtin.Dictionary.ValueAtKey(dictionary=value_for_import_from_others_9.MainInput, key=code_block_55)

# group: Input Manager
value_for_import_from_others_10 = CodeBlock(MainInput=code_block_52) { MainInput; RefInput1; RefInput2; }  # unwired: RefInput1, RefInput2

# group: <Func 4> Ceiling Painting
code_block_56 = CodeBlock { "TargetElements"; }
# note: <Func>
valueAtKey_10 = DesignScript.Builtin.Dictionary.ValueAtKey(dictionary=value_for_import_from_others_10.MainInput, key=code_block_56)

# group: Input Manager
value_for_import_from_others_11 = CodeBlock(MainInput=code_block_52) { MainInput; RefInput1; RefInput2; }  # unwired: RefInput1, RefInput2

# group: <Func 2> Superstructure Work Form Work
code_block_57 = CodeBlock { "TargetElements"; }
# note: <Func>
valueAtKey_11 = DesignScript.Builtin.Dictionary.ValueAtKey(dictionary=value_for_import_from_others_11.MainInput, key=code_block_57)

# group: Input Manager
value_for_import_from_others_12 = CodeBlock(MainInput=code_block_52) { MainInput; RefInput1; RefInput2; }  # unwired: RefInput1, RefInput2

# group: <Func 3> Superstructure Work Rebar Work
code_block_58 = CodeBlock { "TargetElements"; }
# note: <Func>
valueAtKey_12 = DesignScript.Builtin.Dictionary.ValueAtKey(dictionary=value_for_import_from_others_12.MainInput, key=code_block_58)

# group: Output Manager
output_14 = CodeBlock { MainOutput; RefOutput_geoColor; }  # unwired: MainOutput, RefOutput_geoColor
reference_output_14 = CodeBlock { ref; }  # unwired: ref

# group: Visual Manager
visual_켜기_끄기_12 = BoolSelector(false)
visual_manager_12 = Python(IN[0]=output_14.RefOutput_geoColor, IN[1]=visual_켜기_끄기_12)  # CPython3; same code as visual_manager

# group: Output Manager
output_15 = CodeBlock { MainOutput; RefOutput_geoColor; }  # unwired: MainOutput, RefOutput_geoColor
reference_output_15 = CodeBlock { ref; }  # unwired: ref

# group: Visual Manager
visual_켜기_끄기_13 = BoolSelector(false)
visual_manager_13 = Python(IN[0]=output_15.RefOutput_geoColor, IN[1]=visual_켜기_끄기_13)  # CPython3; same code as visual_manager

# group: Output Manager
output_16 = CodeBlock { MainOutput; RefOutput_geoColor; }  # unwired: MainOutput, RefOutput_geoColor
reference_output_16 = CodeBlock { ref; }  # unwired: ref

# group: Visual Manager
visual_켜기_끄기_14 = BoolSelector(false)
visual_manager_14 = Python(IN[0]=output_16.RefOutput_geoColor, IN[1]=visual_켜기_끄기_14)  # CPython3; same code as visual_manager

# group: Output Manager
output_17 = CodeBlock { MainOutput; RefOutput_geoColor; }  # unwired: MainOutput, RefOutput_geoColor
reference_output_17 = CodeBlock { ref; }  # unwired: ref

# group: Visual Manager
visual_켜기_끄기_15 = BoolSelector(false)
visual_manager_15 = Python(IN[0]=output_17.RefOutput_geoColor, IN[1]=visual_켜기_끄기_15)  # CPython3; same code as visual_manager

code_block_59 = CodeBlock { i; }  # unwired: i

# group: Input Manager
value_for_import_from_others_13 = CodeBlock(MainInput=code_block_59) { MainInput; RefInput1; RefInput2; }  # unwired: RefInput1, RefInput2

# group: <Func 4>Roof Protective Concrete
code_block_60 = CodeBlock { "TargetElements"; }
# note: <Func>
valueAtKey_13 = DesignScript.Builtin.Dictionary.ValueAtKey(dictionary=value_for_import_from_others_13.MainInput, key=code_block_60)

# group: Input Manager
value_for_import_from_others_14 = CodeBlock(MainInput=code_block_59) { MainInput; RefInput1; RefInput2; }  # unwired: RefInput1, RefInput2

# group: <Func 3>Roof PE Sheet
code_block_61 = CodeBlock { "TargetElements"; }
# note: <Func>
valueAtKey_14 = DesignScript.Builtin.Dictionary.ValueAtKey(dictionary=value_for_import_from_others_14.MainInput, key=code_block_61)

# group: Input Manager
value_for_import_from_others_15 = CodeBlock(MainInput=code_block_59) { MainInput; RefInput1; RefInput2; }  # unwired: RefInput1, RefInput2

# group: <Func 2>Roof Insulation
code_block_62 = CodeBlock { "TargetElements"; }
# note: <Func>
valueAtKey_15 = DesignScript.Builtin.Dictionary.ValueAtKey(dictionary=value_for_import_from_others_15.MainInput, key=code_block_62)

# group: Input Manager
value_for_import_from_others_16 = CodeBlock(MainInput=code_block_52) { MainInput; RefInput1; RefInput2; }  # unwired: RefInput1, RefInput2

# group: <Func 1>Structural Concrete
code_block_63 = CodeBlock { "TargetElements"; }
# note: <Func>
valueAtKey_16 = DesignScript.Builtin.Dictionary.ValueAtKey(dictionary=value_for_import_from_others_16.MainInput, key=code_block_63)

# group: Output Manager
output_18 = CodeBlock { MainOutput; RefOutput_geoColor; }  # unwired: MainOutput, RefOutput_geoColor
reference_output_18 = CodeBlock { ref; }  # unwired: ref

# group: Visual Manager
visual_켜기_끄기_16 = BoolSelector(false)
visual_manager_16 = Python(IN[0]=output_18.RefOutput_geoColor, IN[1]=visual_켜기_끄기_16)  # CPython3; same code as visual_manager

# group: Output Manager
output_19 = CodeBlock { MainOutput; RefOutput_geoColor; }  # unwired: MainOutput, RefOutput_geoColor
reference_output_19 = CodeBlock { ref; }  # unwired: ref

# group: Visual Manager
visual_켜기_끄기_17 = BoolSelector(false)
visual_manager_17 = Python(IN[0]=output_19.RefOutput_geoColor, IN[1]=visual_켜기_끄기_17)  # CPython3; same code as visual_manager

# group: Output Manager
output_20 = CodeBlock { MainOutput; RefOutput_geoColor; }  # unwired: MainOutput, RefOutput_geoColor
reference_output_20 = CodeBlock { ref; }  # unwired: ref

# group: Visual Manager
visual_켜기_끄기_18 = BoolSelector(false)
visual_manager_18 = Python(IN[0]=output_20.RefOutput_geoColor, IN[1]=visual_켜기_끄기_18)  # CPython3; same code as visual_manager

code_block_64 = CodeBlock { i; }  # unwired: i

# group: Input Manager
value_for_import_from_others_17 = CodeBlock(MainInput=code_block_64) { MainInput; RefInput1; RefInput2; }  # unwired: RefInput1, RefInput2

# group: <Func 3>Superstructure Work Rebar Work
code_block_65 = CodeBlock { "TargetElements"; }
# note: <Func>
valueAtKey_17 = DesignScript.Builtin.Dictionary.ValueAtKey(dictionary=value_for_import_from_others_17.MainInput, key=code_block_65)

# group: Input Manager
value_for_import_from_others_18 = CodeBlock(MainInput=code_block_64) { MainInput; RefInput1; RefInput2; }  # unwired: RefInput1, RefInput2

# group: <Func 4>Ceiling Painting
code_block_66 = CodeBlock { "TargetElements"; }
# note: <Func>
valueAtKey_18 = DesignScript.Builtin.Dictionary.ValueAtKey(dictionary=value_for_import_from_others_18.MainInput, key=code_block_66)

# group: Input Manager
value_for_import_from_others_19 = CodeBlock(MainInput=code_block_59) { MainInput; RefInput1; RefInput2; }  # unwired: RefInput1, RefInput2

# group: <Func 1>Roof Waterproofing
code_block_67 = CodeBlock { "TargetElements"; }
# note: <Func>
valueAtKey_19 = DesignScript.Builtin.Dictionary.ValueAtKey(dictionary=value_for_import_from_others_19.MainInput, key=code_block_67)

# group: Input Manager
value_for_import_from_others_20 = CodeBlock(MainInput=code_block_64) { MainInput; RefInput1; RefInput2; }  # unwired: RefInput1, RefInput2

# group: <Func 2>Superstructure Work Form Work
code_block_68 = CodeBlock { "TargetElements"; }
# note: <Func>
valueAtKey_20 = DesignScript.Builtin.Dictionary.ValueAtKey(dictionary=value_for_import_from_others_20.MainInput, key=code_block_68)

# group: Output Manager
output_21 = CodeBlock { MainOutput; RefOutput_geoColor; }  # unwired: MainOutput, RefOutput_geoColor
reference_output_21 = CodeBlock { ref; }  # unwired: ref

# group: Visual Manager
visual_켜기_끄기_19 = BoolSelector(false)
visual_manager_19 = Python(IN[0]=output_21.RefOutput_geoColor, IN[1]=visual_켜기_끄기_19)  # CPython3; same code as visual_manager

# group: Input Manager
value_for_import_from_others_21 = CodeBlock(MainInput=code_block_64) { MainInput; RefInput1; RefInput2; }  # unwired: RefInput1, RefInput2

# group: <Func 1>Structural Concrete
code_block_69 = CodeBlock { "TargetElements"; }
# note: <Func>
valueAtKey_21 = DesignScript.Builtin.Dictionary.ValueAtKey(dictionary=value_for_import_from_others_21.MainInput, key=code_block_69)

# group: Output Manager
output_22 = CodeBlock { MainOutput; RefOutput_geoColor; }  # unwired: MainOutput, RefOutput_geoColor
reference_output_22 = CodeBlock { ref; }  # unwired: ref

# group: Visual Manager
visual_켜기_끄기_20 = BoolSelector(false)
visual_manager_20 = Python(IN[0]=output_22.RefOutput_geoColor, IN[1]=visual_켜기_끄기_20)  # CPython3; same code as visual_manager

code_block_70 = CodeBlock { i; }  # unwired: i

# group: Input Manager
value_for_import_from_others_22 = CodeBlock(MainInput=code_block_70) { MainInput; RefInput1; RefInput2; }  # unwired: RefInput1, RefInput2

# group: <Func 5> Concrete Protective Coating (U/G)
code_block_71 = CodeBlock { "TargetElements"; }
# note: <Func>
valueAtKey_22 = DesignScript.Builtin.Dictionary.ValueAtKey(dictionary=value_for_import_from_others_22.MainInput, key=code_block_71)

# group: Output Manager
output_23 = CodeBlock { MainOutput; RefOutput_geoColor; }  # unwired: MainOutput, RefOutput_geoColor
reference_output_23 = CodeBlock { ref; }  # unwired: ref

# group: Visual Manager
visual_켜기_끄기_21 = BoolSelector(false)
visual_manager_21 = Python(IN[0]=output_23.RefOutput_geoColor, IN[1]=visual_켜기_끄기_21)  # CPython3; same code as visual_manager

# group: Output Manager
output_24 = CodeBlock { MainOutput; RefOutput_geoColor; }  # unwired: MainOutput, RefOutput_geoColor
reference_output_24 = CodeBlock { ref; }  # unwired: ref

# group: Visual Manager
visual_켜기_끄기_22 = BoolSelector(false)
visual_manager_22 = Python(IN[0]=output_24.RefOutput_geoColor, IN[1]=visual_켜기_끄기_22)  # CPython3; same code as visual_manager

# group: Input Manager
value_for_import_from_others_23 = CodeBlock(MainInput=code_block_70) { MainInput; RefInput1; RefInput2; }  # unwired: RefInput1, RefInput2

# group: <Func 4> Concrete Protective Coating (U/G)
code_block_72 = CodeBlock { "TargetElements"; }
# note: <Func>
valueAtKey_23 = DesignScript.Builtin.Dictionary.ValueAtKey(dictionary=value_for_import_from_others_23.MainInput, key=code_block_72)

# group: Output Manager
output_25 = CodeBlock { MainOutput; RefOutput_geoColor; }  # unwired: MainOutput, RefOutput_geoColor
reference_output_25 = CodeBlock { ref; }  # unwired: ref

# group: Visual Manager
visual_켜기_끄기_23 = BoolSelector(false)
visual_manager_23 = Python(IN[0]=output_25.RefOutput_geoColor, IN[1]=visual_켜기_끄기_23)  # CPython3; same code as visual_manager

# group: Output Manager
output_26 = CodeBlock { MainOutput; RefOutput_geoColor; }  # unwired: MainOutput, RefOutput_geoColor
reference_output_26 = CodeBlock { ref; }  # unwired: ref

# group: Visual Manager
visual_켜기_끄기_24 = BoolSelector(false)
visual_manager_24 = Python(IN[0]=output_26.RefOutput_geoColor, IN[1]=visual_켜기_끄기_24)  # CPython3; same code as visual_manager

# group: Input Manager
value_for_import_from_others_24 = CodeBlock(MainInput=code_block_70) { MainInput; RefInput1; RefInput2; }  # unwired: RefInput1, RefInput2

# group: <Func 2> Substructure Work Form Work
code_block_73 = CodeBlock { "TargetElements"; }
# note: <Func>
valueAtKey_24 = DesignScript.Builtin.Dictionary.ValueAtKey(dictionary=value_for_import_from_others_24.MainInput, key=code_block_73)

# group: Input Manager
value_for_import_from_others_25 = CodeBlock(MainInput=code_block_70) { MainInput; RefInput1; RefInput2; }  # unwired: RefInput1, RefInput2

# group: <Func 3> Substructure Work Rebar Work
code_block_74 = CodeBlock { "TargetElements"; }
# note: <Func>
valueAtKey_25 = DesignScript.Builtin.Dictionary.ValueAtKey(dictionary=value_for_import_from_others_25.MainInput, key=code_block_74)

# group: Input Manager
value_for_import_from_others_26 = CodeBlock(MainInput=code_block_70) { MainInput; RefInput1; RefInput2; }  # unwired: RefInput1, RefInput2

# group: <Func 1> Substructure Work Structural Concrete
code_block_75 = CodeBlock { "TargetElements"; }
# note: <Func>
valueAtKey_26 = DesignScript.Builtin.Dictionary.ValueAtKey(dictionary=value_for_import_from_others_26.MainInput, key=code_block_75)

watch_10 = Watch(select_target_family_element_and_2)

# group: Output Manager
output_27 = CodeBlock { MainOutput; RefOutput_geoColor; }  # unwired: MainOutput, RefOutput_geoColor
reference_output_27 = CodeBlock { ref; }  # unwired: ref

# group: Visual Manager
visual_켜기_끄기_25 = BoolSelector(false)
visual_manager_25 = Python(IN[0]=output_27.RefOutput_geoColor, IN[1]=visual_켜기_끄기_25)  # CPython3; same code as visual_manager

code_block_76 = CodeBlock { i; }  # unwired: i

# group: Input Manager
value_for_import_from_others_27 = CodeBlock(MainInput=code_block_76) { MainInput; RefInput1; RefInput2; }  # unwired: RefInput1, RefInput2

# group: <Func 3> Superstructure Work Rebar Work
code_block_77 = CodeBlock { "TargetElements"; }
# note: <Func>
valueAtKey_27 = DesignScript.Builtin.Dictionary.ValueAtKey(dictionary=value_for_import_from_others_27.MainInput, key=code_block_77)

# group: Output Manager
output_28 = CodeBlock { MainOutput; RefOutput_geoColor; }  # unwired: MainOutput, RefOutput_geoColor
reference_output_28 = CodeBlock { ref; }  # unwired: ref

# group: Visual Manager
visual_켜기_끄기_26 = BoolSelector(false)
visual_manager_26 = Python(IN[0]=output_28.RefOutput_geoColor, IN[1]=visual_켜기_끄기_26)  # CPython3; same code as visual_manager

# group: Output Manager
output_29 = CodeBlock { MainOutput; RefOutput_geoColor; }  # unwired: MainOutput, RefOutput_geoColor
reference_output_29 = CodeBlock { ref; }  # unwired: ref

# group: Visual Manager
visual_켜기_끄기_27 = BoolSelector(false)
visual_manager_27 = Python(IN[0]=output_29.RefOutput_geoColor, IN[1]=visual_켜기_끄기_27)  # CPython3; same code as visual_manager

# group: Input Manager
value_for_import_from_others_28 = CodeBlock(MainInput=code_block_76) { MainInput; RefInput1; RefInput2; }  # unwired: RefInput1, RefInput2

# group: <Func 2> Superstructure Work Form Work
code_block_78 = CodeBlock { "TargetElements"; }
# note: <Func>
valueAtKey_28 = DesignScript.Builtin.Dictionary.ValueAtKey(dictionary=value_for_import_from_others_28.MainInput, key=code_block_78)

# group: Input Manager
value_for_import_from_others_29 = CodeBlock(MainInput=code_block_76) { MainInput; RefInput1; RefInput2; }  # unwired: RefInput1, RefInput2

# group: <Func 1> Superstructure Work Structural Concrete
code_block_79 = CodeBlock { "TargetElements"; }
# note: <Func>
valueAtKey_29 = DesignScript.Builtin.Dictionary.ValueAtKey(dictionary=value_for_import_from_others_29.MainInput, key=code_block_79)

watch_11 = Watch(select_target_family_element_and_3)

# group: Output Manager
output_30 = CodeBlock { MainOutput; RefOutput_geoColor; }  # unwired: MainOutput, RefOutput_geoColor
reference_output_30 = CodeBlock { ref; }  # unwired: ref

# group: Visual Manager
visual_켜기_끄기_28 = BoolSelector(false)
visual_manager_28 = Python(IN[0]=output_30.RefOutput_geoColor, IN[1]=visual_켜기_끄기_28)  # CPython3; same code as visual_manager

# group: Output Manager
output_31 = CodeBlock { MainOutput; RefOutput_geoColor; }  # unwired: MainOutput, RefOutput_geoColor
reference_output_31 = CodeBlock { ref; }  # unwired: ref

# group: Visual Manager
visual_켜기_끄기_29 = BoolSelector(false)
visual_manager_29 = Python(IN[0]=output_31.RefOutput_geoColor, IN[1]=visual_켜기_끄기_29)  # CPython3; same code as visual_manager

# group: Output Manager
output_32 = CodeBlock { MainOutput; RefOutput_geoColor; }  # unwired: MainOutput, RefOutput_geoColor
reference_output_32 = CodeBlock { ref; }  # unwired: ref

# group: Visual Manager
visual_켜기_끄기_30 = BoolSelector(false)
visual_manager_30 = Python(IN[0]=output_32.RefOutput_geoColor, IN[1]=visual_켜기_끄기_30)  # CPython3; same code as visual_manager

code_block_80 = CodeBlock { i; }  # unwired: i

# group: Input Manager
value_for_import_from_others_30 = CodeBlock(MainInput=code_block_80) { MainInput; RefInput1; RefInput2; }  # unwired: RefInput1, RefInput2

# group: <Func 5> Steel Structure Strength Bolt&Nuts
code_block_81 = CodeBlock { "TargetElements"; }
# note: <Func>
valueAtKey_30 = DesignScript.Builtin.Dictionary.ValueAtKey(dictionary=value_for_import_from_others_30.MainInput, key=code_block_81)

# group: Input Manager
value_for_import_from_others_31 = CodeBlock(MainInput=code_block_80) { MainInput; RefInput1; RefInput2; }  # unwired: RefInput1, RefInput2

# group: <Func 4> Steel Structure Painting/Coating
code_block_82 = CodeBlock { "TargetElements"; }
# note: <Func>
valueAtKey_31 = DesignScript.Builtin.Dictionary.ValueAtKey(dictionary=value_for_import_from_others_31.MainInput, key=code_block_82)

# group: Output Manager
output_33 = CodeBlock { MainOutput; RefOutput_geoColor; }  # unwired: MainOutput, RefOutput_geoColor
reference_output_33 = CodeBlock { ref; }  # unwired: ref

# group: Visual Manager
visual_켜기_끄기_31 = BoolSelector(false)
visual_manager_31 = Python(IN[0]=output_33.RefOutput_geoColor, IN[1]=visual_켜기_끄기_31)  # CPython3; same code as visual_manager

# group: Input Manager
value_for_import_from_others_32 = CodeBlock(MainInput=code_block_80) { MainInput; RefInput1; RefInput2; }  # unwired: RefInput1, RefInput2

# group: <Func 2> Steel Structure Weight
code_block_83 = CodeBlock { "TargetElements"; }
# note: <Func>
valueAtKey_32 = DesignScript.Builtin.Dictionary.ValueAtKey(dictionary=value_for_import_from_others_32.MainInput, key=code_block_83)

# group: Input Manager
value_for_import_from_others_33 = CodeBlock(MainInput=code_block_80) { MainInput; RefInput1; RefInput2; }  # unwired: RefInput1, RefInput2

# group: <Func 3> Steel Structure Plates
code_block_84 = CodeBlock { "TargetElements"; }
# note: <Func>
valueAtKey_33 = DesignScript.Builtin.Dictionary.ValueAtKey(dictionary=value_for_import_from_others_33.MainInput, key=code_block_84)

# group: Output Manager
output_34 = CodeBlock { MainOutput; RefOutput_geoColor; }  # unwired: MainOutput, RefOutput_geoColor
reference_output_34 = CodeBlock { ref; }  # unwired: ref

# group: Visual Manager
visual_켜기_끄기_32 = BoolSelector(false)
visual_manager_32 = Python(IN[0]=output_34.RefOutput_geoColor, IN[1]=visual_켜기_끄기_32)  # CPython3; same code as visual_manager

# group: Input Manager
value_for_import_from_others_34 = CodeBlock(MainInput=code_block_80) { MainInput; RefInput1; RefInput2; }  # unwired: RefInput1, RefInput2

# group: <Func 1> Concrete Work Superstructure Work Anchor Bolt (Installation only) (EA)
code_block_85 = CodeBlock { "TargetElements"; }
# note: <Func>
valueAtKey_34 = DesignScript.Builtin.Dictionary.ValueAtKey(dictionary=value_for_import_from_others_34.MainInput, key=code_block_85)

# group: Output Manager
output_35 = CodeBlock { MainOutput; RefOutput_geoColor; }  # unwired: MainOutput, RefOutput_geoColor
reference_output_35 = CodeBlock { ref; }  # unwired: ref

# group: Visual Manager
visual_켜기_끄기_33 = BoolSelector(false)
visual_manager_33 = Python(IN[0]=output_35.RefOutput_geoColor, IN[1]=visual_켜기_끄기_33)  # CPython3; same code as visual_manager

# group: Input Manager
value_for_import_from_others_35 = CodeBlock(MainInput=code_block_80) { MainInput; RefInput1; RefInput2; }  # unwired: RefInput1, RefInput2

# group: <Func 6> Anchor Bolt (EA)
code_block_86 = CodeBlock { "TargetElements"; }
# note: <Func>
valueAtKey_35 = DesignScript.Builtin.Dictionary.ValueAtKey(dictionary=value_for_import_from_others_35.MainInput, key=code_block_86)

# group: Output Manager
output_36 = CodeBlock { MainOutput; RefOutput_geoColor; }  # unwired: MainOutput, RefOutput_geoColor
reference_output_36 = CodeBlock { ref; }  # unwired: ref

# group: Visual Manager
visual_켜기_끄기_34 = BoolSelector(false)
visual_manager_34 = Python(IN[0]=output_36.RefOutput_geoColor, IN[1]=visual_켜기_끄기_34)  # CPython3; same code as visual_manager

# group: Output Manager
output_37 = CodeBlock { MainOutput; RefOutput_geoColor; }  # unwired: MainOutput, RefOutput_geoColor
reference_output_37 = CodeBlock { ref; }  # unwired: ref

# group: Visual Manager
visual_켜기_끄기_35 = BoolSelector(false)
visual_manager_35 = Python(IN[0]=output_37.RefOutput_geoColor, IN[1]=visual_켜기_끄기_35)  # CPython3; same code as visual_manager

# group: Input Manager
value_for_import_from_others_36 = CodeBlock(MainInput=code_block_80) { MainInput; RefInput1; RefInput2; }  # unwired: RefInput1, RefInput2

# group: <Func 10> Steel Structure Fire Proofing Work
code_block_87 = CodeBlock { "TargetElements"; }
# note: <Func>
valueAtKey_36 = DesignScript.Builtin.Dictionary.ValueAtKey(dictionary=value_for_import_from_others_36.MainInput, key=code_block_87)

# group: Input Manager
value_for_import_from_others_37 = CodeBlock(MainInput=code_block_80) { MainInput; RefInput1; RefInput2; }  # unwired: RefInput1, RefInput2

# group: <Func 9> Steel Structure Painting
code_block_88 = CodeBlock { "TargetElements"; }
# note: <Func>
valueAtKey_37 = DesignScript.Builtin.Dictionary.ValueAtKey(dictionary=value_for_import_from_others_37.MainInput, key=code_block_88)

# group: Output Manager
output_38 = CodeBlock { MainOutput; RefOutput_geoColor; }  # unwired: MainOutput, RefOutput_geoColor
reference_output_38 = CodeBlock { ref; }  # unwired: ref

# group: Visual Manager
visual_켜기_끄기_36 = BoolSelector(false)
visual_manager_36 = Python(IN[0]=output_38.RefOutput_geoColor, IN[1]=visual_켜기_끄기_36)  # CPython3; same code as visual_manager

# group: Input Manager
value_for_import_from_others_38 = CodeBlock(MainInput=code_block_80) { MainInput; RefInput1; RefInput2; }  # unwired: RefInput1, RefInput2

# group: <Func 8> Steel Grout
code_block_89 = CodeBlock { "TargetElements"; }
# note: <Func>
valueAtKey_38 = DesignScript.Builtin.Dictionary.ValueAtKey(dictionary=value_for_import_from_others_38.MainInput, key=code_block_89)

# group: Output Manager
output_39 = CodeBlock { MainOutput; RefOutput_geoColor; }  # unwired: MainOutput, RefOutput_geoColor
reference_output_39 = CodeBlock { ref; }  # unwired: ref

# group: Visual Manager
visual_켜기_끄기_37 = BoolSelector(false)
visual_manager_37 = Python(IN[0]=output_39.RefOutput_geoColor, IN[1]=visual_켜기_끄기_37)  # CPython3; same code as visual_manager

# group: Input Manager
value_for_import_from_others_39 = CodeBlock(MainInput=code_block_80) { MainInput; RefInput1; RefInput2; }  # unwired: RefInput1, RefInput2

# group: <Func 7> Steel Structure Weight
code_block_90 = CodeBlock { "TargetElements"; }
# note: <Func>
valueAtKey_39 = DesignScript.Builtin.Dictionary.ValueAtKey(dictionary=value_for_import_from_others_39.MainInput, key=code_block_90)
