# Dynamo graph 04 Str Foundation (1220)_mk.dyn (Dynamo 2.12.0.5650)

# note: 되메우기기

# group: Example
code_block = CodeBlock { ["a","b","c"]; [1,2,3]; }
byKeysValues = DesignScript.Builtin.Dictionary.ByKeysValues(keys=code_block.out0, values=code_block.out1)
code_block_2 = CodeBlock { ["d","e","f"]; [4,5,6]; }
byKeysValues_2 = DesignScript.Builtin.Dictionary.ByKeysValues(keys=code_block_2.out0, values=code_block_2.out1)
code_block_3 = CodeBlock(a1=byKeysValues, b1=byKeysValues_2)
# ---------- code_block_3.designscript (4 lines) ----------
{
"a1": a1
,"b1": b1
};
# ----------------------------------------
code_block_4 = CodeBlock { "a1"; }
valueAtKey = DesignScript.Builtin.Dictionary.ValueAtKey(dictionary=code_block_3, key=code_block_4)
code_block_5 = CodeBlock { "a"; }
valueAtKey_2 = DesignScript.Builtin.Dictionary.ValueAtKey(dictionary=valueAtKey, key=code_block_5)

# group: 하위분개
keys = DesignScript.Builtin.Dictionary.Keys()  # unwired: dictionary
code_block_6 = CodeBlock(i=keys) { i; }
valueAtKey_3 = DesignScript.Builtin.Dictionary.ValueAtKey(key=keys)  # unwired: dictionary
code_block_7 = CodeBlock { -1; }
dropItems = List.DropItems(list=valueAtKey_3, amount=code_block_7)
code_block_8 = CodeBlock { 0; }
code_block_9 = CodeBlock(i=dropItems) { i[0]; i[1]; i[2]; }
flatten = List.Flatten(list=code_block_9.out0)
replaceItemAtIndex = List.ReplaceItemAtIndex(list=dropItems, index=code_block_8, item=flatten)
code_block_10 = CodeBlock { 1; }
flatten_2 = List.Flatten(list=code_block_9.out1@L2)
replaceItemAtIndex_2 = List.ReplaceItemAtIndex(list=replaceItemAtIndex, index=code_block_10, item=flatten_2)
code_block_11 = CodeBlock { 2; }
flatten_3 = List.Flatten(list=code_block_9.out2)
replaceItemAtIndex_3 = List.ReplaceItemAtIndex(list=replaceItemAtIndex_2, index=code_block_11, item=flatten_3)
분개_index_입력 = CodeBlock { [0,4]; }
getItemAtIndex = List.GetItemAtIndex(list=replaceItemAtIndex_3@L3, index=분개_index_입력)
code_block_12 = CodeBlock(i=getItemAtIndex) { i[1]; }
flatten_4 = List.Flatten(list=code_block_12)
uniqueItems = List.UniqueItems(list=flatten_4)
addItemToEnd = List.AddItemToEnd(item=uniqueItems, list=getItemAtIndex)
byKeysValues_3 = DesignScript.Builtin.Dictionary.ByKeysValues(keys=code_block_6, values=addItemToEnd)

code_block_13 = CodeBlock(i=byKeysValues_3) { i; }

# group: Input Manager
value_for_import_from_others = CodeBlock(MainInput=code_block_13) { MainInput; RefInput1; RefInput2; }  # unwired: RefInput1, RefInput2

# group: <Func 9>Lean Concrete
code_block_14 = CodeBlock { "TargetElements"; }
valueAtKey_4 = DesignScript.Builtin.Dictionary.ValueAtKey(dictionary=value_for_import_from_others.MainInput, key=code_block_14)
code_block_15 = CodeBlock { 0; 100; }
# note: <Func>
createLeanConcrete = Custom[CreateLeanConcrete](Element=valueAtKey_4, leanOffset=code_block_15.out0, leanThick=code_block_15.out1)  # CreateLeanConcreteForISOFDN
volume = Solid.Volume(solid=createLeanConcrete.Solid)
code_block_16 = CodeBlock(i=volume) { Math.Round(List.Flatten(i)/1000000000, 2); }
code_block_17 = CodeBlock { "M3"; }
count = List.Count(list=code_block_16)
ofRepeatedItem = List.OfRepeatedItem(item=code_block_17, amount=count)
code_block_18 = CodeBlock(FuncValues=code_block_16, FuncValuesUnit=ofRepeatedItem)
# ---------- code_block_18.designscript (4 lines) ----------
{
"FuncValues": _FuncValues,
"FuncValuesUnit": _FuncValuesUnit
};
# ----------------------------------------

# group: Output Manager
reference_output = CodeBlock(ref=createLeanConcrete.Solid) { ref; }
output = CodeBlock(MainOutput=code_block_18, RefOutput_geoColor=createLeanConcrete.Solid) { MainOutput; RefOutput_geoColor; }

# group: Input Manager
value_for_import_from_others_2 = CodeBlock(MainInput=code_block_13, RefInput1=reference_output) { MainInput; RefInput1; RefInput2; }  # unwired: RefInput2

# group: <Func 4> Excavation (SOG 한정)
flatten_5 = List.Flatten(list=value_for_import_from_others_2.RefInput1)
하부_surface_추출 = Python(IN[0]=flatten_5)  # CPython3
# ---------- 하부_surface_추출.python (26 lines) ----------
# Load the Python Standard and DesignScript Libraries
import sys
import clr
import itertools
clr.AddReference('ProtoGeometry')
from Autodesk.DesignScript.Geometry import *

# The inputs to this node will be stored as a list in the IN variables.
dataEnteringNode = IN
input_elements = IN[0]

# Place your code below this line

srfs_input_elements = list(map(lambda x: x.Explode(), input_elements))

#srfs_input_flatten = list(itertools.chain(*srfs_input_elements))

def func_findZ_normalAtParma(srf):
    return srf.NormalAtParameter(0.5,0.5).Z
srfs_below = list(map(lambda y: filter(lambda x: func_findZ_normalAtParma(x) == -1, y), srfs_input_elements))

result = srfs_below


# Assign your output to the OUT variable.
OUT = result
# ----------------------------------------
flatten_6 = List.Flatten(list=하부_surface_추출)
perimeterCurves = Surface.PerimeterCurves(surface=flatten_6)
byJoinedCurves = PolyCurve.ByJoinedCurves(curves=perimeterCurves)
code_block_19 = CodeBlock { _ExcavOffsetBottom: var[]..[] = 300; }
offset = Curve.Offset(curve=byJoinedCurves, distance=code_block_19)
flatten_7 = List.Flatten(list=offset)
levels = Levels("G.L")  # graph input
elevation = Level.Elevation(level=levels)
code_block_20 = CodeBlock { "TargetElements"; }
valueAtKey_5 = DesignScript.Builtin.Dictionary.ValueAtKey(dictionary=value_for_import_from_others_2.MainInput, key=code_block_20)
code_block_21 = CodeBlock { "Elevation at Bottom"; }
getParameterValueByName = Element.GetParameterValueByName(element=valueAtKey_5, parameterName=code_block_21)
린_콘크리트_하부까지의_길이_추출_최하단 = Python(IN[0]=value_for_import_from_others_2.RefInput1)  # CPython3
# ---------- 린_콘크리트_하부까지의_길이_추출_최하단.python (22 lines) ----------
# Load the Python Standard and DesignScript Libraries
import sys
import clr
clr.AddReference('ProtoGeometry')
from Autodesk.DesignScript.Geometry import *

# The inputs to this node will be stored as a list in the IN variables.
dataEnteringNode = IN
inputs = IN[0]

# Place your code below this line

def findThickness(i):
    minPt_Z = BoundingBox.ByGeometry(i).MinPoint.Z
    maxPt_Z = BoundingBox.ByGeometry(i).MaxPoint.Z
    result = maxPt_Z - minPt_Z
    return result

thicknessByInput = list(map(findThickness, inputs))

# Assign your output to the OUT variable.
OUT = thicknessByInput
# ----------------------------------------
code_block_22 = CodeBlock(기초하단=getParameterValueByName, 린콘크리트하단=린_콘크리트_하부까지의_길이_추출_최하단) { 기초하단-린콘크리트하단; }
sub = elevation - code_block_22
flatten_8 = List.Flatten(list=sub)
translate = Geometry.Translate(geometry=offset, zTranslation=flatten_8)
경사_비율_입력_1_x_for_isofdn = DoubleInput(2)  # graph input
code_block_23 = CodeBlock(ElevationatBottom=flatten_8, 비율=경사_비율_입력_1_x_for_isofdn) { ElevationatBottom/비율; }
offset_2 = Curve.Offset(curve=translate, distance=code_block_23)
flatten_9 = List.Flatten(list=offset_2)
list_create = List.Create(item0=flatten_7, item1=flatten_9)
transpose = List.Transpose(lists=list_create)
byLoft = Solid.ByLoft(crossSections=transpose)
터파기_형상_겹침_해소 = Python(IN[0]=byLoft)  # CPython3
# ---------- 터파기_형상_겹침_해소.python (29 lines) ----------
# Load the Python Standard and DesignScript Libraries
import sys
import clr
clr.AddReference('ProtoGeometry')
from Autodesk.DesignScript.Geometry import *

# The inputs to this node will be stored as a list in the IN variables.
dataEnteringNode = IN
inputs = IN[0]
result = []
# Place your code below this line

for x in range(len(inputs)):
    if x < len(inputs)-1:
        temp = []
        apply = inputs[x]
        for y in range(x,len(inputs)):
            if apply.DoesIntersect(inputs[y]):
                apply = apply.Split(inputs[y])[0]
                temp.append(apply)
            else:
                apply = apply
                temp.append(apply)
        result.append(temp[-1])
    elif x == len(inputs)-1:
        result.append(inputs[x])

# Assign your output to the OUT variable.
OUT = result
# ----------------------------------------
code_block_24 = CodeBlock(i=sub) { i<0?true:false; }
code_block_25 = CodeBlock { 0; }
volume_2 = Solid.Volume(solid=터파기_형상_겹침_해소)
code_block_26 = CodeBlock(i=volume_2) { Math.Round(List.Flatten(i)/1000000000, 2); }
if_ = If(test=code_block_24, true=code_block_25, false=code_block_26)
code_block_27 = CodeBlock { "M3"; }
count_2 = List.Count(list=code_block_26)
ofRepeatedItem_2 = List.OfRepeatedItem(item=code_block_27, amount=count_2)
code_block_28 = CodeBlock(FuncValues=if_, FuncValuesUnit=ofRepeatedItem_2)  # same code as code_block_18
color_palette = ColorPalette({R: 210, G: 105, B: 30, A: 135})
byGeometryColor = Modifiers.GeometryColor.ByGeometryColor(geometry=터파기_형상_겹침_해소, color=color_palette)
forRefOutput = CodeBlock(MainOutput=code_block_28, geoColor=byGeometryColor, 터파기형상=터파기_형상_겹침_해소)
# ---------- forRefOutput.designscript (5 lines) ----------
{
"MainOutput": MainOutput,
"geoColor": geoColor,
"터파기형상": 터파기형상
};
# ----------------------------------------

# group: Output Manager
reference_output_2 = CodeBlock(ref=터파기_형상_겹침_해소, ref2=if_) { ref; ref2; }
output_2 = CodeBlock(MainOutput=forRefOutput, RefOutput_geoColor=byGeometryColor) { MainOutput; RefOutput_geoColor; }

# group: Input Manager
value_for_import_from_others_3 = CodeBlock(MainInput=code_block_13, RefInput1=reference_output_2.ref2) { MainInput; RefInput1; RefInput2; }  # unwired: RefInput2

# group: <Func 6>Disposal
code_block_29 = CodeBlock { "TargetElements"; }
valueAtKey_6 = DesignScript.Builtin.Dictionary.ValueAtKey(dictionary=value_for_import_from_others_3.MainInput, key=code_block_29)
count_3 = List.Count(list=valueAtKey_6@L1)
code_block_30 = CodeBlock(i=value_for_import_from_others_3.RefInput1) { i==0?true:false; }
code_block_31 = CodeBlock { 0; }
# note: <Func>
if_2 = If(test=code_block_30, true=code_block_31, false=value_for_import_from_others_3.RefInput1)
code_block_32 = CodeBlock(i=if_2) { Math.Round(List.Flatten(i)/1000000000, 2); }
code_block_33 = CodeBlock { "M3"; }
count_4 = List.Count(list=code_block_32)
ofRepeatedItem_3 = List.OfRepeatedItem(item=code_block_33, amount=count_4)
code_block_34 = CodeBlock(FuncValues=code_block_32, FuncValuesUnit=ofRepeatedItem_3)  # same code as code_block_18

# group: Distributer
code_block_35 = CodeBlock { i; }  # frozen; unwired: i
code_block_36 = CodeBlock(i=code_block_35) { i; }
code_block_37 = CodeBlock(i=code_block_36) { i; }
code_block_38 = CodeBlock(i=code_block_36) { i; }
code_block_39 = CodeBlock(i=code_block_35) { i; }
code_block_40 = CodeBlock(i=code_block_39) { i; }
code_block_41 = CodeBlock(i=code_block_35) { i; }
code_block_42 = CodeBlock(i=code_block_41) { i; }
code_block_43 = CodeBlock(i=code_block_35) { i; }
code_block_44 = CodeBlock(i=code_block_43) { i; }
code_block_45 = CodeBlock(i=code_block_36) { i; }
code_block_46 = CodeBlock(i=code_block_41) { i; }
code_block_47 = CodeBlock(i=code_block_41) { i; }
code_block_48 = CodeBlock(i=code_block_43) { i; }
code_block_49 = CodeBlock(i=code_block_43) { i; }
code_block_50 = CodeBlock(i=code_block_39) { i; }

code_block_51 = CodeBlock { "TargetElements"; }
valueAtKey_7 = DesignScript.Builtin.Dictionary.ValueAtKey(dictionary=code_block_37, key=code_block_51)
# note: <Func>
extractUpperFacesOfElement = Custom[ExtractUpperFacesOfElement](Element=valueAtKey_7)  # ExtractUpperFacesOfElement

# group: <Func 2> - 수정필요
code_block_52 = CodeBlock { "TargetElements"; }
valueAtKey_8 = DesignScript.Builtin.Dictionary.ValueAtKey(dictionary=code_block_38, key=code_block_52)
# note: <Func>
extractSideFacesOfElement = Custom[ExtractSideFacesOfElement](Element=valueAtKey_8)  # ExtractSideFacesOfElement
area = Surface.Area(surface=extractSideFacesOfElement.Surface)
sum = Math.Sum(values=area)
code_block_53 = CodeBlock(i=sum) { Math.Round(List.Flatten(i)/1000000, 2); }
code_block_54 = CodeBlock { "M2"; }
count_5 = List.Count(list=code_block_53)
ofRepeatedItem_4 = List.OfRepeatedItem(item=code_block_54, amount=count_5)
code_block_55 = CodeBlock(FuncValues=code_block_53, FuncValuesUnit=ofRepeatedItem_4)  # same code as code_block_18

code_block_56 = CodeBlock { "TargetElements"; }
valueAtKey_9 = DesignScript.Builtin.Dictionary.ValueAtKey(dictionary=code_block_40, key=code_block_56)
code_block_57 = CodeBlock { 0; 100; }
createLeanConcrete_2 = Custom[CreateLeanConcrete](Element=valueAtKey_9, leanOffset=code_block_57.out0, leanThick=code_block_57.out1)
code_block_58 = CodeBlock { "TargetElements"; }
valueAtKey_10 = DesignScript.Builtin.Dictionary.ValueAtKey(dictionary=code_block_42, key=code_block_58)
code_block_59 = CodeBlock { 0; }
createExcavationSolid = Custom[CreateExcavationSolid](Element=valueAtKey_10, ExcavOffsetTop=code_block_59, ExcavOffsetBottom=code_block_59)  # CreateExcavationSolidForISOFDN
code_block_60 = CodeBlock { "TargetElements"; }
valueAtKey_11 = DesignScript.Builtin.Dictionary.ValueAtKey(dictionary=code_block_44, key=code_block_60)
createBaseCourseSurfaces = Custom[CreateBaseCourseSurfaces](Element=valueAtKey_11)  # CreateBaseCourseSurfaces; unwired: BaseCourseOffsetBottom, leanThick

# group: See Result
code_block_61 = CodeBlock(SeeResult=extractUpperFacesOfElement.GeometryColor) { SeeResult; }
code_block_62 = CodeBlock(SeeResult=extractSideFacesOfElement.GeometryColor) { SeeResult; }
code_block_63 = CodeBlock(SeeResult=createLeanConcrete_2.GeometryColor) { SeeResult; }
code_block_64 = CodeBlock(SeeResult=createExcavationSolid.GeometryColor) { SeeResult; }
code_block_65 = CodeBlock(SeeResult=createBaseCourseSurfaces.GeometryColor) { SeeResult; }

# group: Primary Input : Excel & Revit Elements
categories = Categories("OST_StructuralFoundation")
all_elements_of_category = ElementsOfCategory(Category=categories)
string_from_web = Python()  # CPython3; unwired: IN[0]
# ---------- string_from_web.python (19 lines) ----------
# Load the Python Standard and DesignScript Libraries
import sys
import clr
clr.AddReference('ProtoGeometry')
from Autodesk.DesignScript.Geometry import *
import urllib.request

# The inputs to this node will be stored as a list in the IN variables.
dataEnteringNode = IN
inputURL = "https://raw.githubusercontent.com/HNANmal/mQ/master/Hdynlib/General/ImportExcel.py"

# Place your code below this line
req = urllib.request
data = req.urlopen(inputURL)

result = data.read().decode("utf-8")

# Assign your output to the OUT variable.
OUT = result
# ----------------------------------------
file_path = Filename(".\BIM_물량집계 자동화 산출기준표_rC(20211207)_강한호 (1).xlsx")  # graph input
sheet_name = CodeBlock { "Str Foundations"; }
github_python_import_excel_by = PythonStringNode(script=string_from_web, IN[0]=file_path, IN[1]=sheet_name)  # "Github_Python@Import Excel(By OpenpyXl)"; CPython3
code_block_66 = CodeBlock(InputElement=all_elements_of_category, InputData=github_python_import_excel_by) { _InputElement; _InputData; }

# group: GetFull WMCodeDescription PerElement
excelDataManagerNode = Python(IN[0]=code_block_66._InputElement, IN[1]=code_block_66._InputData)  # CPython3
# ---------- excelDataManagerNode.python (279 lines) ----------
# Load the Python Standard and DesignScript Libraries
import os
import sys
sys.path.append(os.getenv('LOCALAPPDATA').replace('\\','\\\\') + r'\Programs\Python\Python39\Lib\site-packages')
import clr
clr.AddReference('RevitAPI')
import Autodesk

clr.AddReference('ProtoGeometry')
from Autodesk.DesignScript.Geometry import *

clr.AddReference('RevitNodes')
import Revit
clr.ImportExtensions(Revit.Elements)

clr.ImportExtensions(Revit.GeometryConversion)
clr.ImportExtensions(Revit.GeometryReferences)

clr.AddReference('RevitServices')
import RevitServices
from RevitServices.Persistence import DocumentManager
from RevitServices.Transactions import TransactionManager

doc = DocumentManager.Instance.CurrentDBDocument

import random
import itertools
from functools import reduce
from collections import Iterable
import datetime
import openpyxl

def iterable(obj):
    return isinstance(obj, Iterable)

def findUnique(inputs):
    result = []
    for i in inputs:
        if i in result:
            pass
        else:
            result.append(i)
    return result

# The inputs to this node will be stored as a list in the IN variables.
dataEnteringNode = IN
inputElements = IN[0]
inputData = IN[1]
#inputSheetName = IN[2]

def importExcel(path, SheetNameIn):
    wb_obj = openpyxl.load_workbook(str(path), data_only=True)
    sheet_obj = wb_obj.get_sheet_by_name(str(SheetNameIn))

    m_row = sheet_obj.max_row
    m_col = sheet_obj.max_column

    listOut = []

    for i in range(1, m_row +1):
        listTemp = []
        for j in range(1, m_col + 1):
            cell_obj = sheet_obj.cell(row=i, column=j)
            listTemp.append(cell_obj.value)
            if len(listTemp) == m_col:
                listOut.append(listTemp)
    return listOut

def getUsedFamilyTypeOfModeling(elements):
    familyCode = list(map(lambda x: x.Name.split('_')[0], elements))
    unq_familyCode = findUnique(familyCode)
    return unq_familyCode
    
def createExcelDataDictionary(values):
    result = {}
    for i in range(len(values)):
        result[str(i)] = values[i]
    return result

def findTargetIndex(targets, list):
    result = []
    for target in targets:
        for i in range(len(list)):
            if target in str(list[i]):
                result.append(i)
            else:
                pass
    result.sort()
    return result
    
def GetValueAtKeys(keys, dictionary):
    result = [] 
    for i in keys:
        result.append(dictionary[str(i)])
    return result


# Place your code below this line
usedFamilyTypeOfModeling = getUsedFamilyTypeOfModeling(inputElements)
excelWholeDataSet = inputData#importExcel(inputFilePath, inputSheetName)
trExcelWholeDataSet = list(zip(*excelWholeDataSet))
excelColumnDataSet = createExcelDataDictionary(trExcelWholeDataSet)
excelRowDataSet = createExcelDataDictionary(excelWholeDataSet)
ColumnIndexOfUsedFamilyType = findTargetIndex(usedFamilyTypeOfModeling, trExcelWholeDataSet)
ColDataSetOfUsedFamilyType = GetValueAtKeys(ColumnIndexOfUsedFamilyType, excelColumnDataSet)
materialPerElementFromModeling = []
for i in inputElements:
    materialPerElementFromModeling.append(i.GetMaterials())
#list(map(lambda x: x.GetMaterials, inputElements)) "맵함수로 처리하면 리스트화 할 때 타입 변환 오류 남"

targetWMRowIndex = []
for i in ColDataSetOfUsedFamilyType:
    targetWMRowIndex.append(findTargetIndex(['000'], i))

rowDataSetOfUsedWM = []
for i in targetWMRowIndex:
    rowDataSetOfUsedWM.append(GetValueAtKeys(i, excelRowDataSet))

workGroup = []
for i in rowDataSetOfUsedWM:
    tmp = []
    for j in i:
        tmp.append(j[0])
    workGroup.append(tmp)
    
workMaster = []
for i in range(len(ColDataSetOfUsedFamilyType)):
    tmp=[]
    for k in targetWMRowIndex[i]:
        tmp.append(ColDataSetOfUsedFamilyType[i][k])
    workMaster.append(tmp)

matchedWM = []
for i in range(len(workGroup)):
    tmp = []
    for j in range(len(workGroup[i])):
        fullWM = workGroup[i][j] +"-"+ workMaster[i][j]
        tmp.append(fullWM)
    matchedWM.append(tmp)

matchedWorkGruopAndMasterCode = []
for i in matchedWM:
    if len(i) > 0:
        matchedWorkGruopAndMasterCode.append(i)
    else:
        pass

matchedWMDescription = []
for i in rowDataSetOfUsedWM:
    tmp=[]
    for j in i:
        tmp.append(j[1] +" "+ j[2] +" "+ j[3] +" "+ "("+ j[4] +")")
    if len(tmp) > 0:
        matchedWMDescription.append(tmp)
    else:
        pass

matchedWMUnit = []
for i in rowDataSetOfUsedWM:
    tmp=[]
    for j in i:
        tmp.append(j[4])
    if len(tmp) > 0:
        matchedWMUnit.append(tmp)
    else:
        pass

matchedWorkGruopAndMasterCode_flat = list(itertools.chain(*matchedWorkGruopAndMasterCode))
matchedWMDescription_flat = list(itertools.chain(*matchedWMDescription))

dic_WMandDescription_Excel = {}
for i in range(len(matchedWorkGruopAndMasterCode_flat)):
    dic_WMandDescription_Excel[matchedWorkGruopAndMasterCode_flat[i]] = matchedWMDescription_flat[i]

usedFamilyTypeInExcelOrder = list(map(lambda x: x[3], ColDataSetOfUsedFamilyType))
usedFamilyCodeInExcelOrder = findUnique(list(map(lambda x: x.split('_')[0], usedFamilyTypeInExcelOrder)))

dic_FamilyCodeandWM = {}
for i in range(len(usedFamilyCodeInExcelOrder)):
    dic_FamilyCodeandWM[usedFamilyCodeInExcelOrder[i]] = matchedWorkGruopAndMasterCode[i]

workMasterCodePerElement = []
familyCodePerElem = list(map(lambda x: x.Name.split('_')[0], inputElements))
for i in familyCodePerElem:
    workMasterCodePerElement.append(dic_FamilyCodeandWM[i])

materialNamePerElem = []
for i in materialPerElementFromModeling:
    tmp = []
    for j in i:
        tmp.append(j.Name)
    materialNamePerElem.append(tmp)

WMPerElementFromModeling = []
for i in materialNamePerElem:
    tmp = []
    for j in i:
        tmp.append(j.split('_')[0])
    WMPerElementFromModeling.append(tmp)

specPerElementFromModeling = []
for i in materialNamePerElem:
    tmp = []
    for j in i:
        a = j.split('_')
        del a[0]
        b = " ".join(a)
        tmp.append(b)
    specPerElementFromModeling.append(tmp)

WMPerElementFromModeling_flat = list(itertools.chain(*WMPerElementFromModeling))
specPerElementFromModeling_flat = list(itertools.chain(*specPerElementFromModeling))

dic_WMandDescription_Model = {}
for i in range(len(WMPerElementFromModeling_flat)):
    dic_WMandDescription_Model[WMPerElementFromModeling_flat[i]] = specPerElementFromModeling_flat[i]

def findAllKeys(dict):
    result = []
    for key in dict.keys():
        result.append(key)
    return result

def findAllValues(dict):
    result = []
    for key in dict.keys():
        result.append(dict[key])
    return result

keys_WMandDescription_Model = findAllKeys(dic_WMandDescription_Model)
keys_WMandDescription_Excel = findAllKeys(dic_WMandDescription_Excel)

keys_WMandDescription_Both = list(set(keys_WMandDescription_Model + keys_WMandDescription_Excel))
values_WMandDescription_Both = []
for i in keys_WMandDescription_Both:
    if i in keys_WMandDescription_Model:
        values_WMandDescription_Both.append(dic_WMandDescription_Model[i])
    else:
        values_WMandDescription_Both.append(dic_WMandDescription_Excel[i])

dic_WMandDescription_Both = {}
for i in range(len(keys_WMandDescription_Both)):
    dic_WMandDescription_Both[keys_WMandDescription_Both[i]] = values_WMandDescription_Both[i]

workMasterCodePerElementFromBoth = []
for i in range(len(workMasterCodePerElement)):
    #tmp = []
    a = WMPerElementFromModeling[i] + workMasterCodePerElement[i]
    b = findUnique(a)
    workMasterCodePerElementFromBoth.append(b)

specPerElement = []
for i in workMasterCodePerElementFromBoth:
    tmp = []
    for j in i:
        tmp.append(dic_WMandDescription_Both[j])
    specPerElement.append(tmp)

fullWMCodeDescriptionPerElement = []
for i in range(len(workMasterCodePerElementFromBoth)):
    tmp = []
    for j in range(len(workMasterCodePerElementFromBoth[i])):
        a = workMasterCodePerElementFromBoth[i][j] +": "+ specPerElement[i][j]
        tmp.append(a)
    fullWMCodeDescriptionPerElement.append(tmp)

fullWMinfo = {
"AllElement": inputElements,
"WorkMasterCodePerFamilyType": dic_FamilyCodeandWM,
"WorkMasterCodePerElementBoth": workMasterCodePerElementFromBoth,
"FullWMCodeDescriptionPerElement": fullWMCodeDescriptionPerElement
}



result = fullWMinfo

# Assign your output to the OUT variable.
OUT = result
# ----------------------------------------

# group: Organize AllElementInform AsDictionary
set_up_all_element_inform_as = Python(IN[0]=excelDataManagerNode)  # "Set Up All Element Inform as Dictionary"; CPython3
# ---------- set_up_all_element_inform_as.python (119 lines) ----------
# Load the Python Standard and DesignScript Libraries
import os
import sys
sys.path.append(os.getenv('LOCALAPPDATA').replace('\\','\\\\') + r'\Programs\Python\Python39\Lib\site-packages')
import clr
clr.AddReference('RevitAPI')
import Autodesk

clr.AddReference('ProtoGeometry')
from Autodesk.DesignScript.Geometry import *

clr.AddReference('RevitNodes')
import Revit
clr.ImportExtensions(Revit.Elements)

clr.ImportExtensions(Revit.GeometryConversion)
clr.ImportExtensions(Revit.GeometryReferences)

clr.AddReference('RevitServices')
import RevitServices
from RevitServices.Persistence import DocumentManager
from RevitServices.Transactions import TransactionManager

doc = DocumentManager.Instance.CurrentDBDocument

import random
import itertools
from functools import reduce
from collections import Iterable
import datetime
import openpyxl

def iterable(obj):
    return isinstance(obj, Iterable)

def findUnique(inputs):
    result = []
    for i in inputs:
        if i in result:
            pass
        else:
            result.append(i)
    return result

# The inputs to this node will be stored as a list in the IN variables.
dataEnteringNode = IN
inputDict = IN[0]


def importExcel(path, SheetNameIn):
    wb_obj = openpyxl.load_workbook(str(path), data_only=True)
    sheet_obj = wb_obj.get_sheet_by_name(str(SheetNameIn))

    m_row = sheet_obj.max_row
    m_col = sheet_obj.max_column

    listOut = []

    for i in range(1, m_row +1):
        listTemp = []
        for j in range(1, m_col + 1):
            cell_obj = sheet_obj.cell(row=i, column=j)
            listTemp.append(cell_obj.value)
            if len(listTemp) == m_col:
                listOut.append(listTemp)
    return listOut

def getUsedFamilyTypeOfModeling(elements):
    familyCode = list(map(lambda x: x.Name.split('_')[0], elements))
    unq_familyCode = findUnique(familyCode)
    return unq_familyCode
    
def createExcelDataDictionary(values):
    result = {}
    for i in range(len(values)):
        result[str(i)] = values[i]
    return result

def findTargetIndex(targets, list):
    result = []
    for target in targets:
        for i in range(len(list)):
            if target in str(list[i]):
                result.append(i)
            else:
                pass
    result.sort()
    return result
    
def GetValueAtKeys(keys, dictionary):
    result = [] 
    for i in keys:
        result.append(dictionary[str(i)])
    return result


# Place your code below this line
element = inputDict["AllElement"]
elementType = []
for i in element:
    elementType.append(i.Name)
familyCode = []
for i in elementType:
    familyCode.append(i.split("_")[0])
fullWMCodeDescriptionPerElement = inputDict["FullWMCodeDescriptionPerElement"]

resultDict = {
"Element": element,
"ElementType": elementType,
"FamilyCode": familyCode,
"FullWMCodeDescriptionPerElement": fullWMCodeDescriptionPerElement
}



result = resultDict

# Assign your output to the OUT variable.
OUT = result
# ----------------------------------------

# group: Select Target Family Element And Connected WorkMasters
code_block_67 = CodeBlock { 0; }
select_target_family_element_and = Python(IN[0]=set_up_all_element_inform_as, IN[1]=code_block_67)  # "Select Target Family Element And Connected WorkMasters"; CPython3
# ---------- select_target_family_element_and.python (138 lines) ----------
# Load the Python Standard and DesignScript Libraries
import os
import sys
sys.path.append(os.getenv('LOCALAPPDATA').replace('\\','\\\\') + r'\Programs\Python\Python39\Lib\site-packages')
import clr
clr.AddReference('RevitAPI')
import Autodesk

clr.AddReference('ProtoGeometry')
from Autodesk.DesignScript.Geometry import *

clr.AddReference('RevitNodes')
import Revit
clr.ImportExtensions(Revit.Elements)

clr.ImportExtensions(Revit.GeometryConversion)
clr.ImportExtensions(Revit.GeometryReferences)

clr.AddReference('RevitServices')
import RevitServices
from RevitServices.Persistence import DocumentManager
from RevitServices.Transactions import TransactionManager

doc = DocumentManager.Instance.CurrentDBDocument

import random
import itertools
from functools import reduce
from collections import Iterable
import datetime
import openpyxl

def iterable(obj):
    return isinstance(obj, Iterable)

def findUnique(inputs):
    result = []
    for i in inputs:
        if i in result:
            pass
        else:
            result.append(i)
    return result

# The inputs to this node will be stored as a list in the IN variables.
dataEnteringNode = IN
inputDict = IN[0]
inputIndex = IN[1]


def importExcel(path, SheetNameIn):
    wb_obj = openpyxl.load_workbook(str(path), data_only=True)
    sheet_obj = wb_obj.get_sheet_by_name(str(SheetNameIn))

    m_row = sheet_obj.max_row
    m_col = sheet_obj.max_column

    listOut = []

    for i in range(1, m_row +1):
        listTemp = []
        for j in range(1, m_col + 1):
            cell_obj = sheet_obj.cell(row=i, column=j)
            listTemp.append(cell_obj.value)
            if len(listTemp) == m_col:
                listOut.append(listTemp)
    return listOut

def getUsedFamilyTypeOfModeling(elements):
    familyCode = list(map(lambda x: x.Name.split('_')[0], elements))
    unq_familyCode = findUnique(familyCode)
    return unq_familyCode
    
def createExcelDataDictionary(values):
    result = {}
    for i in range(len(values)):
        result[str(i)] = values[i]
    return result

def findTargetIndex(targets, list):
    result = []
    for target in targets:
        for i in range(len(list)):
            if target in str(list[i]):
                result.append(i)
            else:
                pass
    result.sort()
    return result
    
def GetValueAtKeys(keys, dictionary):
    result = [] 
    for i in keys:
        result.append(dictionary[str(i)])
    return result


# Place your code below this line
fullWMCodeDescriptionPerElement = inputDict["FullWMCodeDescriptionPerElement"]
element = inputDict["Element"]
familyCode = inputDict["FamilyCode"]
familyCode_unique = findUnique(familyCode)
targetFamilyCode = familyCode_unique[inputIndex]
targetIndex = []
for i in range(len(familyCode)):
    if targetFamilyCode in familyCode[i]:
        targetIndex.append(i)
    else:
        pass

targetElements = []
for i in targetIndex:
    targetElements.append(element[i])

targetFamilyCode = []
for i in targetIndex:
    targetFamilyCode.append(element[i].Name)

WMforTargetElements = []
for i in targetIndex:
    WMforTargetElements.append(fullWMCodeDescriptionPerElement[i])

WMforTargetElements_flat = list(itertools.chain(*WMforTargetElements))
targetWMunique = findUnique(WMforTargetElements_flat)

resultDict = {
"TargetElements": targetElements,
"TargetFamilyCode": targetFamilyCode,
"WMforTargetElements": WMforTargetElements,
"TargetWMunique": targetWMunique
}



result = resultDict

# Assign your output to the OUT variable.
OUT = result
# ----------------------------------------

code_block_68 = CodeBlock(i=select_target_family_element_and) { i; }

# group: <Func 0> Input Manager
value_for_import_from_others_4 = CodeBlock(MainInput=code_block_68) { MainInput; RefInput; }  # unwired: RefInput

# group: <Func 0> Structural Concrete
code_block_69 = CodeBlock { "TargetElements"; }
valueAtKey_12 = DesignScript.Builtin.Dictionary.ValueAtKey(dictionary=value_for_import_from_others_4.MainInput, key=code_block_69)
code_block_70 = CodeBlock { "Volume"; }
# note: <Func>
getParameterValueByName_2 = Element.GetParameterValueByName(element=valueAtKey_12, parameterName=code_block_70)
code_block_71 = CodeBlock(i=getParameterValueByName_2) { Math.Round(List.Flatten(i)/1, 2); }
code_block_72 = CodeBlock { "M3"; }
count_6 = List.Count(list=code_block_71)
ofRepeatedItem_5 = List.OfRepeatedItem(item=code_block_72, amount=count_6)
code_block_73 = CodeBlock(FuncValues=code_block_71, FuncValuesUnit=ofRepeatedItem_5)  # same code as code_block_18

# group: <Func 0> Output Manager
output_3 = CodeBlock(MainOutput=code_block_73) { MainOutput; RefOutput1; RefOutput2; }  # unwired: RefOutput1, RefOutput2
reference_output_3 = CodeBlock { ref; }  # unwired: ref

# group: <Func 5> Input Manager
value_for_import_from_others_5 = CodeBlock(MainInput=code_block_68) { MainInput; RefInput; }  # unwired: RefInput

# group: <Func 5> Lean Concrete
code_block_74 = CodeBlock { "TargetElements"; }
valueAtKey_13 = DesignScript.Builtin.Dictionary.ValueAtKey(dictionary=value_for_import_from_others_5.MainInput, key=code_block_74)
# note: <Func>
createLeanConcrete_3 = Custom[CreateLeanConcrete](Element=valueAtKey_13)
flatten_10 = List.Flatten(list=createLeanConcrete_3.Solid)
value_for_export_to_others = CodeBlock(린콘크리트형상=flatten_10) { 린콘크리트형상; }
volume_3 = Solid.Volume(solid=createLeanConcrete_3.Solid)
code_block_75 = CodeBlock(i=volume_3) { Math.Round(List.Flatten(i)/1000000000, 2); }
code_block_76 = CodeBlock { "M3"; }
count_7 = List.Count(list=code_block_75)
ofRepeatedItem_6 = List.OfRepeatedItem(item=code_block_76, amount=count_7)
code_block_77 = CodeBlock(FuncValues=code_block_75, FuncValuesUnit=ofRepeatedItem_6)  # same code as code_block_18

# group: <Func 5> Output Manager
reference_output_4 = CodeBlock(ref=value_for_export_to_others) { ref; }
output_4 = CodeBlock(MainOutput=code_block_77, RefOutput_geoColor=createLeanConcrete_3.GeometryColor) { MainOutput; RefOutput_geoColor; }

# group: <Func 1> Input Manager
value_for_import_from_others_6 = CodeBlock(MainInput=code_block_68, RefInput=reference_output_4) { MainInput; RefInput; }

# group: <Func 1-1> Excavation by IsoFDN
하부_surface_추출_2 = Python(IN[0]=value_for_import_from_others_6.RefInput)  # CPython3; same code as 하부_surface_추출
flatten_11 = List.Flatten(list=하부_surface_추출_2)
perimeterCurves_2 = Surface.PerimeterCurves(surface=flatten_11)
byJoinedCurves_2 = PolyCurve.ByJoinedCurves(curves=perimeterCurves_2)
code_block_78 = CodeBlock { _ExcavOffsetBottom: var[]..[] = 300; }
offset_3 = Curve.Offset(curve=byJoinedCurves_2, distance=code_block_78)
flatten_12 = List.Flatten(list=offset_3)
levels_2 = Levels("G.L")  # graph input
elevation_2 = Level.Elevation(level=levels_2)
code_block_79 = CodeBlock { "TargetElements"; }
valueAtKey_14 = DesignScript.Builtin.Dictionary.ValueAtKey(dictionary=value_for_import_from_others_6.MainInput, key=code_block_79)
code_block_80 = CodeBlock { "Elevation at Bottom"; }
getParameterValueByName_3 = Element.GetParameterValueByName(element=valueAtKey_14, parameterName=code_block_80)
린_콘크리트_하부까지의_길이_추출_최하단_2 = Python(IN[0]=value_for_import_from_others_6.RefInput)  # CPython3; same code as 린_콘크리트_하부까지의_길이_추출_최하단
code_block_81 = CodeBlock(기초하단=getParameterValueByName_3, 린콘크리트하단=린_콘크리트_하부까지의_길이_추출_최하단_2) { 기초하단-린콘크리트하단; }
sub_2 = elevation_2 - code_block_81
code_block_82 = CodeBlock { 0; }
isNull = Object.IsNull()  # unwired: object
replaceByCondition = Replace(item=sub_2, replaceWith=code_block_82, condition=isNull)
flatten_13 = List.Flatten(list=replaceByCondition)
translate_2 = Geometry.Translate(geometry=offset_3, zTranslation=flatten_13)
경사_비율_입력_1_x_for_isofdn_2 = DoubleInput(2)  # graph input
code_block_83 = CodeBlock(ElevationatBottom=flatten_13, 비율=경사_비율_입력_1_x_for_isofdn_2) { ElevationatBottom/비율; }
offset_4 = Curve.Offset(curve=translate_2, distance=code_block_83)
flatten_14 = List.Flatten(list=offset_4)
list_create_2 = List.Create(item0=flatten_12, item1=flatten_14)
transpose_2 = List.Transpose(lists=list_create_2)
byLoft_2 = Solid.ByLoft(crossSections=transpose_2)
터파기_형상_겹침_해소_2 = Python(IN[0]=byLoft_2)  # CPython3; same code as 터파기_형상_겹침_해소
volume_4 = Solid.Volume(solid=터파기_형상_겹침_해소_2)
code_block_84 = CodeBlock(i=volume_4) { Math.Round(List.Flatten(i)/1000000000, 2); }
code_block_85 = CodeBlock { "M3"; }
count_8 = List.Count(list=code_block_84)
ofRepeatedItem_7 = List.OfRepeatedItem(item=code_block_85, amount=count_8)
code_block_86 = CodeBlock(FuncValues=code_block_84, FuncValuesUnit=ofRepeatedItem_7)  # same code as code_block_18
color_palette_2 = ColorPalette({R: 210, G: 105, B: 30, A: 135})
byGeometryColor_2 = Modifiers.GeometryColor.ByGeometryColor(geometry=터파기_형상_겹침_해소_2, color=color_palette_2)
forRefOutput_2 = CodeBlock(MainOutput=code_block_86, geoColor=byGeometryColor_2, 터파기형상=터파기_형상_겹침_해소_2)  # same code as forRefOutput

# group: <Func 1-2> Excavation by Overall
하부_surface_추출_3 = Python(IN[0]=value_for_import_from_others_6.RefInput)  # CPython3; same code as 하부_surface_추출
flatten_15 = List.Flatten(list=하부_surface_추출_3)
byGeometry = BoundingBox.ByGeometry(geom=flatten_15)
toCuboid = BoundingBox.ToCuboid(boundingBox=byGeometry)
code_block_87 = CodeBlock(i=toCuboid) { [i]; }
하부_surface_추출_4 = Python(IN[0]=code_block_87)  # CPython3; same code as 하부_surface_추출
perimeterCurves_3 = Surface.PerimeterCurves(surface=하부_surface_추출_4)
byJoinedCurves_3 = PolyCurve.ByJoinedCurves(curves=perimeterCurves_3)
code_block_88 = CodeBlock { _ExcavOffsetBottom: var[]..[] = 300; }
offset_5 = Curve.Offset(curve=byJoinedCurves_3, distance=code_block_88)
flatten_16 = List.Flatten(list=offset_5)
levels_3 = Levels("G.L")  # graph input
elevation_3 = Level.Elevation(level=levels_3)
code_block_89 = CodeBlock { "TargetElements"; }
valueAtKey_15 = DesignScript.Builtin.Dictionary.ValueAtKey(dictionary=value_for_import_from_others_6.MainInput, key=code_block_89)
code_block_90 = CodeBlock { "Elevation at Bottom"; }
getParameterValueByName_4 = Element.GetParameterValueByName(element=valueAtKey_15, parameterName=code_block_90)
린_콘크리트_하부까지의_길이_추출_최하단_3 = Python(IN[0]=value_for_import_from_others_6.RefInput)  # CPython3; same code as 린_콘크리트_하부까지의_길이_추출_최하단
code_block_91 = CodeBlock(기초하단=getParameterValueByName_4, 린콘크리트하단=린_콘크리트_하부까지의_길이_추출_최하단_3) { 기초하단-린콘크리트하단; }
uniqueItems_2 = List.UniqueItems(list=code_block_91@L2)
sub_3 = elevation_3 - uniqueItems_2
code_block_92 = CodeBlock { 0; }
isNull_2 = Object.IsNull()  # unwired: object
replaceByCondition_2 = Replace(item=sub_3, replaceWith=code_block_92, condition=isNull_2)
flatten_17 = List.Flatten(list=replaceByCondition_2)
translate_3 = Geometry.Translate(geometry=offset_5, zTranslation=flatten_17)
경사_비율_입력_1_x_for_overall = DoubleInput(2)  # graph input
code_block_93 = CodeBlock(ElevationatBottom=flatten_17, 비율=경사_비율_입력_1_x_for_overall) { ElevationatBottom/비율; }
offset_6 = Curve.Offset(curve=translate_3, distance=code_block_93)
flatten_18 = List.Flatten(list=offset_6)
list_create_3 = List.Create(item0=flatten_16, item1=flatten_18)
transpose_3 = List.Transpose(lists=list_create_3)
byLoft_3 = Solid.ByLoft(crossSections=transpose_3)
터파기_형상_겹침_해소_3 = Python(IN[0]=byLoft_3)  # CPython3; same code as 터파기_형상_겹침_해소
volume_5 = Solid.Volume(solid=터파기_형상_겹침_해소_3)
code_block_94 = CodeBlock(i=volume_5) { Math.Round(List.Flatten(i)/1000000000, 2); }
code_block_95 = CodeBlock { "M3"; }
count_9 = List.Count(list=code_block_94)
ofRepeatedItem_8 = List.OfRepeatedItem(item=code_block_95, amount=count_9)
code_block_96 = CodeBlock(FuncValues=code_block_94, FuncValuesUnit=ofRepeatedItem_8)  # same code as code_block_18
color_palette_3 = ColorPalette({R: 210, G: 105, B: 30, A: 135})
byGeometryColor_3 = Modifiers.GeometryColor.ByGeometryColor(geometry=터파기_형상_겹침_해소_3, color=color_palette_3)
forRefOutput_3 = CodeBlock(MainOutput=code_block_96, geoColor=byGeometryColor_3, 터파기형상=터파기_형상_겹침_해소_3)  # same code as forRefOutput

# group: 함수 선택
터파기_산출_타입_선택_iso_or_overall = StringInput("iso")  # graph input
code_block_97 = CodeBlock(functionName=터파기_산출_타입_선택_iso_or_overall) { functionName == "iso"? true:false; }
if_3 = If(test=code_block_97, true=forRefOutput_2, false=forRefOutput_3)

# group: <Func 1> Output Manager
code_block_98 = CodeBlock { "MainOutput"; }
valueAtKey_16 = DesignScript.Builtin.Dictionary.ValueAtKey(dictionary=if_3, key=code_block_98)
code_block_99 = CodeBlock { "geoColor"; }
valueAtKey_17 = DesignScript.Builtin.Dictionary.ValueAtKey(dictionary=if_3, key=code_block_99)
output_5 = CodeBlock(MainOutput=valueAtKey_16, RefOutput_geoColor=valueAtKey_17) { MainOutput; RefOutput_geoColor; }
code_block_100 = CodeBlock { "터파기형상"; }
valueAtKey_18 = DesignScript.Builtin.Dictionary.ValueAtKey(dictionary=if_3, key=code_block_100)
reference_output_5 = CodeBlock(터파기형상=valueAtKey_18) { 터파기형상; }

# group: <Func 2> Input Manager
value_for_import_from_others_7 = CodeBlock(MainInput=code_block_68, RefInput1=reference_output_5, RefInput2=reference_output_4) { MainInput; RefInput1; RefInput2; }

# group: <Func 2> Backfill
value_for_import_from_others_8 = CodeBlock(터파기형상=value_for_import_from_others_7.RefInput1) { 터파기형상; }
flatten_19 = List.Flatten(list=value_for_import_from_others_8)
volume_6 = Solid.Volume(solid=flatten_19)
flatten_20 = List.Flatten(list=value_for_import_from_others_7.RefInput2)
code_block_101 = CodeBlock { "TargetElements"; }
valueAtKey_19 = DesignScript.Builtin.Dictionary.ValueAtKey(dictionary=value_for_import_from_others_7.MainInput, key=code_block_101)
geometry = Element.Geometry(element=valueAtKey_19)
flatten_21 = List.Flatten(list=geometry)
categories_2 = Categories("OST_StructuralColumns")
all_elements_of_category_2 = ElementsOfCategory(Category=categories_2)
geometry_2 = Element.Geometry(element=all_elements_of_category_2)
flatten_22 = List.Flatten(list=geometry_2)
doesIntersect = Geometry.DoesIntersect(geometry=flatten_19, other=flatten_22, lacing=CrossProduct)
filterByBoolMask = List.FilterByBoolMask(list=flatten_22, mask=doesIntersect@L2)
flatten_23 = List.Flatten(list=filterByBoolMask.in)
list_create_4 = List.Create(item0=flatten_20, item1=flatten_21, item2=flatten_23)
transpose_4 = List.Transpose(lists=list_create_4)
byUnion = Solid.ByUnion(solids=transpose_4)
volume_7 = Solid.Volume(solid=byUnion)
code_block_102 = CodeBlock(터파기볼륨=volume_6, 콘크리트들볼륨=volume_7) { 터파기볼륨 - 콘크리트들볼륨; }
watch = Watch(code_block_102)
code_block_103 = CodeBlock(i=watch) { Math.Round(List.Flatten(i)/1000000000, 2); }
code_block_104 = CodeBlock { "M3"; }
count_10 = List.Count(list=watch)
ofRepeatedItem_9 = List.OfRepeatedItem(item=code_block_104, amount=count_10)
# note: 터파기 물량ㅈ에서 콘크리트, 린 기둥 물량 빼기
code_block_105 = CodeBlock(FuncValues=code_block_103, FuncValuesUnit=ofRepeatedItem_9)  # same code as code_block_18

# group: <Func 2> Output Manager
output_6 = CodeBlock(MainOutput=code_block_105) { MainOutput; RefOutput_geoColor; }  # unwired: RefOutput_geoColor
reference_output_6 = CodeBlock(콘크리트들볼륨=volume_7) { 콘크리트들볼륨; }

# group: <Func 3> Input Manager
value_for_import_from_others_9 = CodeBlock(MainInput=code_block_68, RefInput1=reference_output_6) { MainInput; RefInput1; RefInput2; }  # unwired: RefInput2

# group: <Func 3> Disposal (잔토처리 1.2 비율)
watch_2 = Watch(value_for_import_from_others_9.RefInput1)
토량_환산_계수 = DoubleInput(1)  # graph input
code_block_106 = CodeBlock(i=watch_2, 토량환산계수=토량_환산_계수) { Math.Round(List.Flatten(i)/1000000000, 2)*토량환산계수; }
code_block_107 = CodeBlock { "M3"; }
count_11 = List.Count(list=watch_2)
ofRepeatedItem_10 = List.OfRepeatedItem(item=code_block_107, amount=count_11)
# note: 잔토처리
code_block_108 = CodeBlock(FuncValues=code_block_106, FuncValuesUnit=ofRepeatedItem_10)  # same code as code_block_18

# group: <Func 3> Output Manager
output_7 = CodeBlock(MainOutput=code_block_108) { MainOutput; RefOutput_geoColor; }  # unwired: RefOutput_geoColor
reference_output_7 = CodeBlock { ref; }  # unwired: ref

# group: <Func 4> Input Manager
value_for_import_from_others_10 = CodeBlock(MainInput=code_block_68) { MainInput; RefInput1; RefInput2; }  # unwired: RefInput1, RefInput2

code_block_109 = CodeBlock { 300; 100; }

# group: <Func 4> Base Course
code_block_110 = CodeBlock { "TargetElements"; }
valueAtKey_20 = DesignScript.Builtin.Dictionary.ValueAtKey(dictionary=value_for_import_from_others_10.MainInput, key=code_block_110)
# note: <Func>
createBaseCourseSurfaces_2 = Custom[CreateBaseCourseSurfaces](Element=valueAtKey_20, BaseCourseOffsetBottom=code_block_109.out0, leanThick=code_block_109.out1)
area_2 = Surface.Area(surface=createBaseCourseSurfaces_2.Surface)
code_block_111 = CodeBlock(i=area_2) { Math.Round(List.Flatten(i)/1000000, 2); }
code_block_112 = CodeBlock { "M2"; }
count_12 = List.Count(list=code_block_111)
ofRepeatedItem_11 = List.OfRepeatedItem(item=code_block_112, amount=count_12)
code_block_113 = CodeBlock(FuncValues=code_block_111, FuncValuesUnit=ofRepeatedItem_11)  # same code as code_block_18

# group: <Func 4> Output Manager
output_8 = CodeBlock(MainOutput=code_block_113, RefOutput_geoColor=createBaseCourseSurfaces_2.GeometryColor) { MainOutput; RefOutput_geoColor; }
reference_output_8 = CodeBlock { ref; }  # unwired: ref

# group: <Func 6> Input Manager
value_for_import_from_others_11 = CodeBlock(MainInput=code_block_68) { MainInput; RefInput1; RefInput2; }  # unwired: RefInput1, RefInput2

# group: <Func 6> Form Works
code_block_114 = CodeBlock { "TargetElements"; }
valueAtKey_21 = DesignScript.Builtin.Dictionary.ValueAtKey(dictionary=value_for_import_from_others_11.MainInput, key=code_block_114)
# note: <Func>
extractSideFacesOfElement_2 = Custom[ExtractSideFacesOfElement](Element=valueAtKey_21)
area_3 = Surface.Area(surface=extractSideFacesOfElement_2.Surface)
sum_2 = Math.Sum(values=area_3)
code_block_115 = CodeBlock(i=sum_2) { Math.Round(List.Flatten(i)/1000000, 2); }
code_block_116 = CodeBlock { "M2"; }
count_13 = List.Count(list=code_block_115)
ofRepeatedItem_12 = List.OfRepeatedItem(item=code_block_116, amount=count_13)
code_block_117 = CodeBlock(FuncValues=code_block_115, FuncValuesUnit=ofRepeatedItem_12)  # same code as code_block_18

# group: <Func 6> Output Manager
output_9 = CodeBlock(MainOutput=code_block_117, RefOutput_geoColor=extractSideFacesOfElement_2.GeometryColor) { MainOutput; RefOutput_geoColor; }
reference_output_9 = CodeBlock { ref; }  # unwired: ref

# group: <Func 7> Input Manager
value_for_import_from_others_12 = CodeBlock(MainInput=code_block_68) { MainInput; RefInput1; RefInput2; factor; }  # unwired: RefInput1, RefInput2, factor

# group: <Func 7> Rebar
code_block_118 = CodeBlock { "TargetElements"; }
valueAtKey_22 = DesignScript.Builtin.Dictionary.ValueAtKey(dictionary=value_for_import_from_others_12.MainInput, key=code_block_118)
code_block_119 = CodeBlock { "Volume"; }
# note: <Func>
getParameterValueByName_5 = Element.GetParameterValueByName(element=valueAtKey_22, parameterName=code_block_119)
독립기초_철근비 = DoubleInput(0)  # graph input
mul = getParameterValueByName_5 * 독립기초_철근비
code_block_120 = CodeBlock(i=mul) { Math.Round(List.Flatten(i)/1, 2); }
code_block_121 = CodeBlock { "TON"; }
count_14 = List.Count(list=code_block_120)
ofRepeatedItem_13 = List.OfRepeatedItem(item=code_block_121, amount=count_14)
code_block_122 = CodeBlock(FuncValues=code_block_120, FuncValuesUnit=ofRepeatedItem_13)  # same code as code_block_18

# group: <Func 7> Output Manager
output_10 = CodeBlock(MainOutput=code_block_122) { MainOutput; RefOutput_geoColor; }  # unwired: RefOutput_geoColor
reference_output_10 = CodeBlock { ref; }  # unwired: ref

# group: <Func 8> Input Manager
value_for_import_from_others_13 = CodeBlock(MainInput=code_block_68) { MainInput; RefInput1; RefInput2; }  # unwired: RefInput1, RefInput2

# group: <Func 8> Sheet Memebrane
code_block_123 = CodeBlock { "TargetElements"; }
valueAtKey_23 = DesignScript.Builtin.Dictionary.ValueAtKey(dictionary=value_for_import_from_others_13.MainInput, key=code_block_123)
# note: <Func>
createLeanConcrete_4 = Custom[CreateLeanConcrete](Element=valueAtKey_23)
area_4 = Surface.Area(surface=createLeanConcrete_4.Surface)
code_block_124 = CodeBlock(i=area_4) { Math.Round(List.Flatten(i)/1000000, 2); }
code_block_125 = CodeBlock { "M2"; }
count_15 = List.Count(list=code_block_124)
ofRepeatedItem_14 = List.OfRepeatedItem(item=code_block_125, amount=count_15)
code_block_126 = CodeBlock(FuncValues=code_block_124, FuncValuesUnit=ofRepeatedItem_14)  # same code as code_block_18

# group: <Func 8> Output Manager
output_11 = CodeBlock(MainOutput=code_block_126) { MainOutput; RefOutput_geoColor; }  # unwired: RefOutput_geoColor
reference_output_11 = CodeBlock { ref; }  # unwired: ref

# group: <Func 9> Input Manager
value_for_import_from_others_14 = CodeBlock(MainInput=code_block_68) { MainInput; RefInput1; RefInput2; }  # unwired: RefInput1, RefInput2

# group: <Func 9> Membrane Protection Board (측면 + 상부면 중 pedestal 점유면적 제외)
code_block_127 = CodeBlock { "TargetElements"; }
# note: <Func>
valueAtKey_24 = DesignScript.Builtin.Dictionary.ValueAtKey(dictionary=value_for_import_from_others_14.MainInput, key=code_block_127)
code_block_128 = CodeBlock(Element=valueAtKey_24) { _Element; }
extractUpperFacesOfElement_2 = Custom[ExtractUpperFacesOfElement](Element=code_block_128)
flatten_24 = List.Flatten(list=extractUpperFacesOfElement_2.Surface)
getJoinedElements = Element.GetJoinedElements(element=code_block_128)
flatten_25 = List.Flatten(list=getJoinedElements)
extractBelowFacesOfElement = Custom[ExtractBelowFacesOfElement](Element=flatten_25)  # ExtractBelowFacesOfElement
flatten_26 = List.Flatten(list=extractBelowFacesOfElement.Surface)
doesIntersect_2 = Geometry.DoesIntersect(geometry=flatten_26, other=flatten_24, lacing=CrossProduct)
code_block_129 = CodeBlock { true; }
allIndicesOf = List.AllIndicesOf(list=doesIntersect_2@L2, item=code_block_129)
flatten_27 = List.Flatten(list=allIndicesOf)
groupByKey = List.GroupByKey(list=flatten_26, keys=flatten_27)
difference = Surface.Difference(surface=flatten_24, others=groupByKey.groups)
extractSideFacesOfElement_3 = Custom[ExtractSideFacesOfElement](Element=code_block_128)
addItemToFront = List.AddItemToFront(item=difference@L1, list=extractSideFacesOfElement_3.Surface@L2)
area_5 = Surface.Area(surface=addItemToFront)
sum_3 = Math.Sum(values=area_5)
code_block_130 = CodeBlock(i=sum_3) { Math.Round(List.Flatten(i)/1000000, 2); }
code_block_131 = CodeBlock { "M2"; }
count_16 = List.Count(list=code_block_130)
ofRepeatedItem_15 = List.OfRepeatedItem(item=code_block_131, amount=count_16)
code_block_132 = CodeBlock(FuncValues=code_block_130, FuncValuesUnit=ofRepeatedItem_15)  # same code as code_block_18
color_palette_4 = ColorPalette({R: 30, G: 144, B: 255, A: 129})
byGeometryColor_4 = Modifiers.GeometryColor.ByGeometryColor(geometry=addItemToFront, color=color_palette_4)

# group: <Func 9> Output Manager
output_12 = CodeBlock(MainOutput=code_block_132, RefOutput_geoColor=byGeometryColor_4) { MainOutput; RefOutput_geoColor; }
reference_output_12 = CodeBlock { ref; }  # unwired: ref

join = List.Join(list0=output_3.MainOutput, list1=output_5.MainOutput, list2=output_6.MainOutput, list3=output_7.MainOutput, list4=output_8.MainOutput, list5=output_4.MainOutput, list6=output_9.MainOutput, list7=output_10.MainOutput, list8=output_11.MainOutput, list9=output_12.MainOutput)

# group: TargetWMunique + Data Sending
code_block_133 = CodeBlock(InputDic2=join) { _InputDic2; }
count_17 = List.Count(list=code_block_133)
code_block_134 = CodeBlock(InputDic1=code_block_68) { _InputDic1; }
code_block_135 = CodeBlock { "TargetWMunique"; }
valueAtKey_25 = DesignScript.Builtin.Dictionary.ValueAtKey(dictionary=code_block_134, key=code_block_135)
watch_3 = Watch(valueAtKey_25)
count_18 = List.Count(list=watch_3)
eq = count_17 == count_18
organizeFuncValuesAndWorkMasterAsDiction = Custom[OrganizeFuncValuesAndWorkMasterAsDictionary](InputDic1=code_block_134, InputDic2=code_block_133)  # Organize FuncValues and WorkMaster As Dictionary
watch_4 = Watch()  # unwired: arg0
if_4 = If(test=eq, true=organizeFuncValuesAndWorkMasterAsDiction, false=watch_4)

# group: 데이터 취합 및 Row 방향 정렬
code_block_136 = CodeBlock(InputDic=if_4) { _InputDic; }
code_block_137 = CodeBlock { "TrTargetFamilyCode"; }
valueAtKey_26 = DesignScript.Builtin.Dictionary.ValueAtKey(dictionary=code_block_136, key=code_block_137)
watch_5 = Watch(valueAtKey_26)
flatten_28 = List.Flatten(list=watch_5)
code_block_138 = CodeBlock { "WMforTargetElements"; }
valueAtKey_27 = DesignScript.Builtin.Dictionary.ValueAtKey(dictionary=code_block_136, key=code_block_138)
watch_6 = Watch(valueAtKey_27)
flatten_29 = List.Flatten(list=watch_6)
code_block_139 = CodeBlock { "TargetFuncValues"; }
valueAtKey_28 = DesignScript.Builtin.Dictionary.ValueAtKey(dictionary=code_block_136, key=code_block_139)
watch_7 = Watch(valueAtKey_28)
flatten_30 = List.Flatten(list=watch_7)
code_block_140 = CodeBlock { "TargetFuncValuesUnit"; }
valueAtKey_29 = DesignScript.Builtin.Dictionary.ValueAtKey(dictionary=code_block_136, key=code_block_140)
watch_8 = Watch(valueAtKey_29)
flatten_31 = List.Flatten(list=watch_8)
list_create_5 = List.Create(item0=flatten_28, item1=flatten_29, item2=flatten_30, item3=flatten_31)
transpose_5 = List.Transpose(lists=list_create_5)

# group: TargetWMunique + Data Sending
code_block_141 = CodeBlock { _InputDic2; }  # unwired: InputDic2
count_19 = List.Count(list=code_block_141)
code_block_142 = CodeBlock { _InputDic1; }  # unwired: InputDic1
code_block_143 = CodeBlock { "TargetWMunique"; }
valueAtKey_30 = DesignScript.Builtin.Dictionary.ValueAtKey(dictionary=code_block_142, key=code_block_143)
watch_9 = Watch(valueAtKey_30)
count_20 = List.Count(list=watch_9)
eq_2 = count_19 == count_20
organizeFuncValuesAndWorkMasterAsDiction_2 = Custom[OrganizeFuncValuesAndWorkMasterAsDictionary](InputDic1=code_block_142, InputDic2=code_block_141)
watch_10 = Watch()  # unwired: arg0
if_5 = If(test=eq_2, true=organizeFuncValuesAndWorkMasterAsDiction_2, false=watch_10)

# group: 데이터 취합 및 Row 방향 정렬
code_block_144 = CodeBlock(InputDic=if_5) { _InputDic; }
code_block_145 = CodeBlock { "TrTargetFamilyCode"; }
valueAtKey_31 = DesignScript.Builtin.Dictionary.ValueAtKey(dictionary=code_block_144, key=code_block_145)
watch_11 = Watch(valueAtKey_31)
flatten_32 = List.Flatten(list=watch_11)
code_block_146 = CodeBlock { "WMforTargetElements"; }
valueAtKey_32 = DesignScript.Builtin.Dictionary.ValueAtKey(dictionary=code_block_144, key=code_block_146)
watch_12 = Watch(valueAtKey_32)
flatten_33 = List.Flatten(list=watch_12)
code_block_147 = CodeBlock { "TargetFuncValues"; }
valueAtKey_33 = DesignScript.Builtin.Dictionary.ValueAtKey(dictionary=code_block_144, key=code_block_147)
watch_13 = Watch(valueAtKey_33)
flatten_34 = List.Flatten(list=watch_13)
code_block_148 = CodeBlock { "TargetFuncValuesUnit"; }
valueAtKey_34 = DesignScript.Builtin.Dictionary.ValueAtKey(dictionary=code_block_144, key=code_block_148)
watch_14 = Watch(valueAtKey_34)
flatten_35 = List.Flatten(list=watch_14)
list_create_6 = List.Create(item0=flatten_32, item1=flatten_33, item2=flatten_34, item3=flatten_35)
transpose_6 = List.Transpose(lists=list_create_6)

area_6 = Surface.Area(surface=extractUpperFacesOfElement.Surface)
sum_4 = Math.Sum(values=area_6)
code_block_149 = CodeBlock(i=sum_4) { Math.Round(List.Flatten(i)/1000000, 2); }
code_block_150 = CodeBlock { "M3"; }
count_21 = List.Count(list=code_block_149)
ofRepeatedItem_16 = List.OfRepeatedItem(item=code_block_150, amount=count_21)
code_block_151 = CodeBlock(FuncValues=code_block_149, FuncValuesUnit=ofRepeatedItem_16)  # same code as code_block_18
code_block_152 = CodeBlock { "TargetElements"; }
valueAtKey_35 = DesignScript.Builtin.Dictionary.ValueAtKey(dictionary=code_block_45, key=code_block_152)
code_block_153 = CodeBlock { "Volume"; }
getParameterValueByName_6 = Element.GetParameterValueByName(element=valueAtKey_35, parameterName=code_block_153)
code_block_154 = CodeBlock(i=getParameterValueByName_6) { Math.Round(List.Flatten(i)/1000000, 2); }
code_block_155 = CodeBlock { "M3"; }
count_22 = List.Count(list=code_block_154)
ofRepeatedItem_17 = List.OfRepeatedItem(item=code_block_155, amount=count_22)
code_block_156 = CodeBlock(FuncValues=code_block_154, FuncValuesUnit=ofRepeatedItem_17)  # same code as code_block_18
code_block_157 = CodeBlock { "TargetElements"; }
valueAtKey_36 = DesignScript.Builtin.Dictionary.ValueAtKey(dictionary=code_block_46, key=code_block_157)
createLeanConcrete_5 = Custom[CreateLeanConcrete](Element=valueAtKey_36)
area_7 = Surface.Area(surface=createLeanConcrete_5.Surface)
code_block_158 = CodeBlock(i=area_7) { Math.Round(List.Flatten(i)/1000000, 2); }
code_block_159 = CodeBlock { "M2"; }
count_23 = List.Count(list=code_block_158)
ofRepeatedItem_18 = List.OfRepeatedItem(item=code_block_159, amount=count_23)
code_block_160 = CodeBlock(FuncValues=code_block_158, FuncValuesUnit=ofRepeatedItem_18)  # same code as code_block_18
map = List.Map()  # unwired: list, function
isNull_3 = Object.IsNull(object=createExcavationSolid.Solid)
code_block_161 = CodeBlock { 1; }
mul_2 = _ * code_block_161  # unwired: x
volume_8 = Solid.Volume()  # unwired: solid
if_6 = If(test=isNull_3, true=mul_2, false=volume_8)
code_block_162 = CodeBlock { 0; }
isNull_4 = Object.IsNull()  # unwired: object
replaceByCondition_3 = Replace(item=createExcavationSolid.Solid, replaceWith=code_block_162, condition=isNull_4)
laceShortest = List.LaceShortest(combineFunction=map, list0=if_6, list1=replaceByCondition_3)
code_block_163 = CodeBlock(i=laceShortest) { Math.Round(List.Flatten(i)/1000000000, 2); }
code_block_164 = CodeBlock { "M3"; }
count_24 = List.Count(list=code_block_163)
ofRepeatedItem_19 = List.OfRepeatedItem(item=code_block_164, amount=count_24)
code_block_165 = CodeBlock(FuncValues=code_block_163, FuncValuesUnit=ofRepeatedItem_19)  # same code as code_block_18
code_block_166 = CodeBlock { 0; }
code_block_167 = CodeBlock { "TargetElements"; }
valueAtKey_37 = DesignScript.Builtin.Dictionary.ValueAtKey(dictionary=code_block_47, key=code_block_167)
count_25 = List.Count(list=valueAtKey_37@L1)
ofRepeatedItem_20 = List.OfRepeatedItem(item=code_block_166, amount=count_25)
code_block_168 = CodeBlock(i=ofRepeatedItem_20) { Math.Round(List.Flatten(i)/1000000000, 2); }
code_block_169 = CodeBlock { "M3"; }
count_26 = List.Count(list=code_block_168)
ofRepeatedItem_21 = List.OfRepeatedItem(item=code_block_169, amount=count_26)
code_block_170 = CodeBlock(FuncValues=code_block_168, FuncValuesUnit=ofRepeatedItem_21)  # same code as code_block_18
code_block_171 = CodeBlock { 0; }
code_block_172 = CodeBlock { "TargetElements"; }
valueAtKey_38 = DesignScript.Builtin.Dictionary.ValueAtKey(dictionary=code_block_48, key=code_block_172)
count_27 = List.Count(list=valueAtKey_38@L1)
ofRepeatedItem_22 = List.OfRepeatedItem(item=code_block_171, amount=count_27)
code_block_173 = CodeBlock(i=ofRepeatedItem_22) { Math.Round(List.Flatten(i)/1000000000, 2); }
code_block_174 = CodeBlock { "M3"; }
count_28 = List.Count(list=code_block_173)
ofRepeatedItem_23 = List.OfRepeatedItem(item=code_block_174, amount=count_28)
code_block_175 = CodeBlock(FuncValues=code_block_173, FuncValuesUnit=ofRepeatedItem_23)  # same code as code_block_18
area_8 = Surface.Area(surface=createBaseCourseSurfaces.Surface)
code_block_176 = CodeBlock(i=area_8) { Math.Round(List.Flatten(i)/1000000, 2); }
code_block_177 = CodeBlock { "M2"; }
count_29 = List.Count(list=code_block_176)
ofRepeatedItem_24 = List.OfRepeatedItem(item=code_block_177, amount=count_29)
code_block_178 = CodeBlock(FuncValues=code_block_176, FuncValuesUnit=ofRepeatedItem_24)  # same code as code_block_18
code_block_179 = CodeBlock { 0; }
code_block_180 = CodeBlock { "TargetElements"; }
valueAtKey_39 = DesignScript.Builtin.Dictionary.ValueAtKey(dictionary=code_block_49, key=code_block_180)
count_30 = List.Count(list=valueAtKey_39@L1)
ofRepeatedItem_25 = List.OfRepeatedItem(item=code_block_179, amount=count_30)
code_block_181 = CodeBlock(i=ofRepeatedItem_25) { Math.Round(List.Flatten(i)/1000000000, 2); }
code_block_182 = CodeBlock { "M3"; }
count_31 = List.Count(list=code_block_181)
ofRepeatedItem_26 = List.OfRepeatedItem(item=code_block_182, amount=count_31)
code_block_183 = CodeBlock(FuncValues=code_block_181, FuncValuesUnit=ofRepeatedItem_26)  # same code as code_block_18
volume_9 = Solid.Volume(solid=createLeanConcrete_2.Solid)
code_block_184 = CodeBlock(i=volume_9) { Math.Round(List.Flatten(i)/1000000000, 2); }
code_block_185 = CodeBlock { "M3"; }
count_32 = List.Count(list=code_block_184)
ofRepeatedItem_27 = List.OfRepeatedItem(item=code_block_185, amount=count_32)
code_block_186 = CodeBlock(FuncValues=code_block_184, FuncValuesUnit=ofRepeatedItem_27)  # same code as code_block_18
code_block_187 = CodeBlock { "TargetElements"; }
valueAtKey_40 = DesignScript.Builtin.Dictionary.ValueAtKey(dictionary=code_block_50, key=code_block_187)
code_block_188 = CodeBlock { "Volume"; }
getParameterValueByName_7 = Element.GetParameterValueByName(element=valueAtKey_40, parameterName=code_block_188)
code_block_189 = CodeBlock { 0.1; }
mul_3 = getParameterValueByName_7 * code_block_189
code_block_190 = CodeBlock(i=mul_3) { Math.Round(List.Flatten(i)/1, 2); }
code_block_191 = CodeBlock { "TON"; }
count_33 = List.Count(list=code_block_190)
ofRepeatedItem_28 = List.OfRepeatedItem(item=code_block_191, amount=count_33)
code_block_192 = CodeBlock(FuncValues=code_block_190, FuncValuesUnit=ofRepeatedItem_28)  # same code as code_block_18
join_2 = List.Join(list0=code_block_151, list1=code_block_156, list2=code_block_55, list3=code_block_160, list4=code_block_165, list5=code_block_170, list6=code_block_175, list7=code_block_178, list8=code_block_183, list9=code_block_186, list10=code_block_192)

# group: TargetWMunique + Data Sending
code_block_193 = CodeBlock(InputDic2=join_2) { _InputDic2; }
count_34 = List.Count(list=code_block_193)
code_block_194 = CodeBlock(InputDic1=code_block_35) { _InputDic1; }
code_block_195 = CodeBlock { "TargetWMunique"; }
valueAtKey_41 = DesignScript.Builtin.Dictionary.ValueAtKey(dictionary=code_block_194, key=code_block_195)
watch_15 = Watch(valueAtKey_41)
count_35 = List.Count(list=watch_15)
eq_3 = count_34 == count_35
organizeFuncValuesAndWorkMasterAsDiction_3 = Custom[OrganizeFuncValuesAndWorkMasterAsDictionary](InputDic1=code_block_194, InputDic2=code_block_193)
watch_16 = Watch()  # unwired: arg0
if_7 = If(test=eq_3, true=organizeFuncValuesAndWorkMasterAsDiction_3, false=watch_16)

# group: 데이터 취합 및 Row 방향 정렬
code_block_196 = CodeBlock(InputDic=if_7) { _InputDic; }
code_block_197 = CodeBlock { "TrTargetFamilyCode"; }
valueAtKey_42 = DesignScript.Builtin.Dictionary.ValueAtKey(dictionary=code_block_196, key=code_block_197)
watch_17 = Watch(valueAtKey_42)
flatten_36 = List.Flatten(list=watch_17)
code_block_198 = CodeBlock { "WMforTargetElements"; }
valueAtKey_43 = DesignScript.Builtin.Dictionary.ValueAtKey(dictionary=code_block_196, key=code_block_198)
watch_18 = Watch(valueAtKey_43)
flatten_37 = List.Flatten(list=watch_18)
code_block_199 = CodeBlock { "TargetFuncValues"; }
valueAtKey_44 = DesignScript.Builtin.Dictionary.ValueAtKey(dictionary=code_block_196, key=code_block_199)
watch_19 = Watch(valueAtKey_44)
flatten_38 = List.Flatten(list=watch_19)
code_block_200 = CodeBlock { "TargetFuncValuesUnit"; }
valueAtKey_45 = DesignScript.Builtin.Dictionary.ValueAtKey(dictionary=code_block_196, key=code_block_200)
watch_20 = Watch(valueAtKey_45)
flatten_39 = List.Flatten(list=watch_20)
list_create_7 = List.Create(item0=flatten_36, item1=flatten_37, item2=flatten_38, item3=flatten_39)
transpose_7 = List.Transpose(lists=list_create_7)

# group: 패밀리 별 취합 + Export Excel(By OpenpyXl)
# note: Excel Export Button
boolean = BoolSelector(false)
join_3 = List.Join(list0=transpose_5, list1=transpose_6, list2=transpose_7)
watch_21 = Watch()  # unwired: arg0
if_8 = If(test=boolean, true=join_3, false=watch_21)
python_script_export_excel_by = Python(IN[0]=if_8)  # "Python Script@Export Excel(By OpenpyXl)"; CPython3
# ---------- python_script_export_excel_by.python (151 lines) ----------
# Load the Python Standard and DesignScript Libraries
import sys
import os
#sys.path.append(r'C:\Users\HEC\AppData\Local\Programs\Python\Python39\Lib\site-packages')
#sys.path.append(r'C:\Users\pjmk0\AppData\Local\Programs\Python\Python39\Lib\site-packages')
sys.path.append(os.getenv('LOCALAPPDATA').replace('\\','\\\\') + r'\Programs\Python\Python39\Lib\site-packages')
import clr
clr.AddReference('ProtoGeometry')
from Autodesk.DesignScript.Geometry import *
from collections import Iterable

def iterable(obj):
    return isinstance(obj, Iterable)


# The inputs to this node will be stored as a list in the IN variables.
dataEnteringNode = IN
ListIn = IN[0]

# Place your code below this line
import datetime
from datetime import date, timedelta
Today = date.today()
import openpyxl
from openpyxl.styles import Border, Side, PatternFill, Font, GradientFill, Alignment, Color, numbers

sample_items = ListIn


def write_to_file(filepath):
    wb = openpyxl.Workbook()
    for sheet in wb.sheetnames:
        wb.remove(wb[sheet])

    thin = Side(border_style="thin", color="000000")
    double = Side(border_style="double", color="000000")

    ws = wb.create_sheet(title='Wall_Calc_instance', index=0)

    ws.merge_cells('A1:L1')
    ws['A1'] = 'HEC Wall Category Calculation Sheet'
    cell = ws['A1']
    cell.font = openpyxl.styles.Font(color='000000', size=20)
    cell.fill = openpyxl.styles.fills.PatternFill(patternType='solid',
                                                  fgColor=openpyxl.styles.colors.Color(rgb='fff3b0'))

    ws['A2'] = 'Item Number'
    ws['A2'].font = openpyxl.styles.Font(b=True, color='000000', size=12)
    #ws['B2'] = 'Member Name'
    #ws['B2'].font = openpyxl.styles.Font(b=True, color='000000', size=12)
    #ws['C2'] = 'Category'
    #ws['C2'].font = openpyxl.styles.Font(b=True, color='000000', size=12)
    ws['B2'] = 'Family Type'
    ws['B2'].font = openpyxl.styles.Font(b=True, color='000000', size=12)
    ws['C2'] = 'WorkMaster Code'
    ws['C2'].font = openpyxl.styles.Font(b=True, color='000000', size=12)
    #ws['F2'] = 'WorkMaster Description'
    #ws['F2'].font = openpyxl.styles.Font(b=True, color='000000', size=12)
    #ws['G2'] = 'Unit'
    #ws['G2'].font = openpyxl.styles.Font(b=True, color='000000', size=12)
    #ws['H2'] = '계수'
    #ws['H2'].font = openpyxl.styles.Font(b=True, color='000000', size=12)
    #ws['I2'] = '계산 참조값'
    #ws['I2'].font = openpyxl.styles.Font(b=True, color='000000', size=12)
    ws['D2'] = 'Quantities'
    ws['D2'].font = openpyxl.styles.Font(b=True, color='000000', size=12)
    ws['E2'] = 'Unit'
    ws['E2'].font = openpyxl.styles.Font(b=True, color='000000', size=12)
    ws['F2'] = 'Unit Price'
    ws['F2'].font = openpyxl.styles.Font(b=True, color='000000', size=12)
    ws['G2'] = 'Total Price'
    ws['G2'].font = openpyxl.styles.Font(b=True, color='000000', size=12)


## 칼럼별 너비 조정 구간
#    for col in range(ws.max_column):
#        ws.column_dimensions[chr(ord('A') + col)].width = 15
    ws.column_dimensions['A'].width = 15
    ws.column_dimensions['B'].width = 45
    ws.column_dimensions['C'].width = 60
    ws.column_dimensions['D'].width = 20
    ws.column_dimensions['E'].width = 20
    ws.column_dimensions['F'].width = 20
    ws.column_dimensions['G'].width = 20
    #ws.column_dimensions['G'].width = 9
    #ws.column_dimensions['H'].width = 9
    #ws.column_dimensions['H'].hidden = True
    #ws.column_dimensions['I'].width = 12
    #ws.column_dimensions['I'].hidden = True
    #ws.column_dimensions['J'].width = 12
    #ws.column_dimensions['K'].width = 12
    #ws.column_dimensions['L'].width = 12

###
    start_row = 3
    for (row, item) in enumerate(sample_items, start_row):
        cell = ws.cell(row=row, column=1, value=row - 2)
        cell.alignment = openpyxl.styles.Alignment(horizontal='center', vertical='center')

#        cell = ws.cell(row=row, column=2, value=item[0])
#        cell.number_format = openpyxl.styles.numbers.FORMAT_DATE_YYYYMMDD2  # 'yyyy-mm-dd'
        ws.cell(row=row, column=2, value=item[0]) ## Family Type 칼럼

        ws.cell(row=row, column=3, value=item[1]) ## WorkMaster Code 칼럼
        
        ws.cell(row=row, column=4, value=item[2]) ## Quantities 칼럼
        
        ws.cell(row=row, column=5, value=item[3]) ## Unit 칼럼
        
        #cell = ws.cell(row=row, column=8, value=item[6]) ## 계수 칼럼
        #cell.number_format = openpyxl.styles.numbers.builtin_format_code(3)  # '#,##0'
        
        #cell = ws.cell(row=row, column=9, value=item[7]) ## 계산 참조값 칼럼
        #cell.number_format = openpyxl.styles.numbers.builtin_format_code(3)  # '#,##0'
        
        #cell = ws.cell(row=row, column=10, value=item[8]) ## Quantities 칼럼
        #cell.number_format = openpyxl.styles.numbers.builtin_format_code(3)  # '#,##0'
        #cell.font = openpyxl.styles.Font(b=True, color='000000', size=11)

        cell = ws.cell(row=row, column=7, value='= D{current_row}*F{current_row}'.format(current_row=cell.row))
        cell.number_format = '#,##0'

#        cell = ws.cell(row=row, column=6, value='= D{current_row} * E{current_row}'.format(current_row=cell.row))
#        cell.number_format = openpyxl.styles.numbers.builtin_format_code(3)

    total_row = ws.max_row + 1
    if total_row > start_row:
        cell1 = ws.cell(row=total_row, column=6, value='Total')
        cell1.font = openpyxl.styles.Font(b=True, color='000000', size=15)
        
        cell2 = ws.cell(row=total_row, column=7, value='= SUM(G{}:G{})'.format(start_row, total_row - 1))
        cell2.number_format = openpyxl.styles.numbers.builtin_format_code(3)
        cell2.border = Border(top=double, left=double, right=double, bottom=double)
        cell2.font = openpyxl.styles.Font(b=True, color='ff03ce', size=15)
    

    wb.save(filepath)
    wb.close()


##if __name__ == '__main__':
#write_to_file('C:\\Users\\pjmk0\\AppData\\Roaming\\test.xlsx')

save_name = "HecStrFDNCalcSheet_" + Today.strftime("%Y-%m-%d")+".xlsx"
path = os.getenv('APPDATA').replace('\\','\\\\')
filePath = path + '\\' + save_name

write_to_file(filePath)

# Assign your output to the OUT variable.
OUT = os.getenv('APPDATA')
# ----------------------------------------

# group: <Func 1> Visual Manager
visual_켜기_끄기 = BoolSelector(true)
visual_manager = Python(IN[0]=output_5.RefOutput_geoColor, IN[1]=visual_켜기_끄기)  # CPython3
# ---------- visual_manager.python (18 lines) ----------
# Load the Python Standard and DesignScript Libraries
import sys
import clr
clr.AddReference('ProtoGeometry')
from Autodesk.DesignScript.Geometry import *

# The inputs to this node will be stored as a list in the IN variables.
dataEnteringNode = IN
geoColors = IN[0]
blnForVisual = IN[1]

# Place your code below this line
if blnForVisual == True:
    result = geoColors
else:
    result = 0
# Assign your output to the OUT variable.
OUT = result
# ----------------------------------------

# group: <Func 4> Visual Manager
visual_켜기_끄기_2 = BoolSelector(true)
visual_manager_2 = Python(IN[0]=output_8.RefOutput_geoColor, IN[1]=visual_켜기_끄기_2)  # CPython3; same code as visual_manager

# group: <Func 5> Visual Manager
visual_켜기_끄기_3 = BoolSelector(true)
visual_manager_3 = Python(IN[0]=output_4.RefOutput_geoColor, IN[1]=visual_켜기_끄기_3)  # CPython3; same code as visual_manager

# group: <Func 6> Visual Manager
visual_켜기_끄기_4 = BoolSelector(true)
visual_manager_4 = Python(IN[0]=output_9.RefOutput_geoColor, IN[1]=visual_켜기_끄기_4)  # CPython3; same code as visual_manager

# group: <Func 6> Visual Manager
visual_켜기_끄기_5 = BoolSelector(true)
visual_manager_5 = Python(IN[0]=output_12.RefOutput_geoColor, IN[1]=visual_켜기_끄기_5)  # CPython3; same code as visual_manager

# group: Input Manager
value_for_import_from_others_15 = CodeBlock(MainInput=code_block_13) { MainInput; RefInput1; RefInput2; }  # unwired: RefInput1, RefInput2

# group: <Func 0> Hardner Finish (상부면)
code_block_201 = CodeBlock { "TargetElements"; }
# note: <Func>
valueAtKey_46 = DesignScript.Builtin.Dictionary.ValueAtKey(dictionary=value_for_import_from_others_15.MainInput, key=code_block_201)
flatten_40 = List.Flatten(list=valueAtKey_46)
# note: 일반화 여지가 있음
# (형상처리구간 + 물량계산 + 데이터 매칭)
extractUpperFacesOfElement_3 = Custom[ExtractUpperFacesOfElement](Element=flatten_40)
area_9 = Surface.Area(surface=extractUpperFacesOfElement_3.Surface)
sum_5 = Math.Sum(values=area_9)
code_block_202 = CodeBlock(i=sum_5) { Math.Round(List.Flatten(i)/1000000, 2); }
code_block_203 = CodeBlock { "M2"; }
count_36 = List.Count(list=code_block_202)
ofRepeatedItem_29 = List.OfRepeatedItem(item=code_block_203, amount=count_36)
code_block_204 = CodeBlock(FuncValues=code_block_202, FuncValuesUnit=ofRepeatedItem_29)  # same code as code_block_18
color_palette_5 = ColorPalette({R: 30, G: 144, B: 255, A: 129})
byGeometryColor_5 = Modifiers.GeometryColor.ByGeometryColor(geometry=extractUpperFacesOfElement_3.Surface, color=color_palette_5)

# group: Output Manager
reference_output_13 = CodeBlock { ref; }  # unwired: ref
output_13 = CodeBlock(MainOutput=code_block_204, RefOutput_geoColor=byGeometryColor_5) { MainOutput; RefOutput_geoColor; }

# group: <Func 6> Visual Manager
visual_켜기_끄기_6 = BoolSelector(false)
visual_manager_6 = Python(IN[0]=output_13.RefOutput_geoColor, IN[1]=visual_켜기_끄기_6)  # CPython3; same code as visual_manager

# group: Visual Manager
visual_켜기_끄기_7 = BoolSelector(false)
visual_manager_7 = Python(IN[0]=output_2.RefOutput_geoColor, IN[1]=visual_켜기_끄기_7)  # CPython3; same code as visual_manager

# group: Output Manager
reference_output_14 = CodeBlock { ref; }  # unwired: ref
output_14 = CodeBlock(MainOutput=code_block_34) { MainOutput; RefOutput_geoColor; }  # unwired: RefOutput_geoColor

# group: Visual Manager
visual_켜기_끄기_8 = BoolSelector(false)
visual_manager_8 = Python(IN[0]=output.RefOutput_geoColor, IN[1]=visual_켜기_끄기_8)  # CPython3; same code as visual_manager

# group: Input Manager
value_for_import_from_others_16 = CodeBlock(MainInput=code_block_13) { MainInput; RefInput1; RefInput2; }  # unwired: RefInput1, RefInput2

# group: <Func 1> Structural Concrete
code_block_205 = CodeBlock { "TargetElements"; }
valueAtKey_47 = DesignScript.Builtin.Dictionary.ValueAtKey(dictionary=value_for_import_from_others_16.MainInput, key=code_block_205)
# note: <Func>
geometry_3 = Element.Geometry(element=valueAtKey_47)
volume_10 = Solid.Volume(solid=geometry_3)
code_block_206 = CodeBlock(i=volume_10) { Math.Round(List.Flatten(i)/1000000000,2); }
code_block_207 = CodeBlock { "M3"; }
count_37 = List.Count(list=code_block_206)
ofRepeatedItem_30 = List.OfRepeatedItem(item=code_block_207, amount=count_37)
code_block_208 = CodeBlock(FuncValues=code_block_206, FuncValuesUnit=ofRepeatedItem_30)  # same code as code_block_18

# group: Output Manager
output_15 = CodeBlock(MainOutput=code_block_208) { MainOutput; RefOutput_geoColor; }  # unwired: RefOutput_geoColor
reference_output_15 = CodeBlock(ref=geometry_3) { ref; }

# group: Input Manager
value_for_import_from_others_17 = CodeBlock(MainInput=code_block_13) { MainInput; RefInput1; RefInput2; }  # unwired: RefInput1, RefInput2

# group: <Func 2> Form Works (Ground Slab 거푸집 필요X)
code_block_209 = CodeBlock { "TargetElements"; }
valueAtKey_48 = DesignScript.Builtin.Dictionary.ValueAtKey(dictionary=value_for_import_from_others_17.MainInput, key=code_block_209)
code_block_210 = CodeBlock { "Volume"; }
# note: <Func>
getParameterValueByName_8 = Element.GetParameterValueByName(element=valueAtKey_48, parameterName=code_block_210)
code_block_211 = CodeBlock(i=getParameterValueByName_8) { Math.Round(List.Flatten(i)/10000000,2); }
code_block_212 = CodeBlock { "M3"; }
count_38 = List.Count(list=code_block_211)
ofRepeatedItem_31 = List.OfRepeatedItem(item=code_block_212, amount=count_38)
code_block_213 = CodeBlock(FuncValues=code_block_211, FuncValuesUnit=ofRepeatedItem_31)  # same code as code_block_18

# group: Output Manager
reference_output_16 = CodeBlock { ref; }  # unwired: ref
output_16 = CodeBlock(MainOutput=code_block_213) { MainOutput; RefOutput_geoColor; }  # unwired: RefOutput_geoColor

# group: Input Manager
value_for_import_from_others_18 = CodeBlock(MainInput=code_block_13) { MainInput; RefInput1; RefInput2; }  # unwired: RefInput1, RefInput2

# group: <Func 3> PE Sheet
code_block_214 = CodeBlock { "TargetElements"; }
valueAtKey_49 = DesignScript.Builtin.Dictionary.ValueAtKey(dictionary=value_for_import_from_others_18.MainInput, key=code_block_214)
# note: <Func>
createLeanConcrete_6 = Custom[CreateLeanConcrete](Element=valueAtKey_49)
area_10 = Surface.Area(surface=createLeanConcrete_6.Surface)
code_block_215 = CodeBlock(i=area_10) { Math.Round(List.Flatten(i)/1000000, 2); }
code_block_216 = CodeBlock { "M2"; }
count_39 = List.Count(list=code_block_215)
ofRepeatedItem_32 = List.OfRepeatedItem(item=code_block_216, amount=count_39)
code_block_217 = CodeBlock(FuncValues=code_block_215, FuncValuesUnit=ofRepeatedItem_32)  # same code as code_block_18

# group: Output Manager
reference_output_17 = CodeBlock { ref; }  # unwired: ref
output_17 = CodeBlock(MainOutput=code_block_217) { MainOutput; RefOutput_geoColor; }  # unwired: RefOutput_geoColor

# group: Input Manager
value_for_import_from_others_19 = CodeBlock(MainInput=code_block_13, RefInput1=reference_output, RefInput2=reference_output_2.ref, RefInput3=reference_output_15) { MainInput; RefInput1; RefInput2; RefInput3; }

# group: <Func 2> Backfill
value_for_import_from_others_20 = CodeBlock(터파기형상=value_for_import_from_others_19.RefInput2) { 터파기형상; }
flatten_41 = List.Flatten(list=value_for_import_from_others_20)
volume_11 = Solid.Volume(solid=flatten_41)
watch_22 = Watch(volume_11)
code_block_218 = CodeBlock(i=watch_22) { Math.Round(List.Flatten(i)/1000000000, 2); }
code_block_219 = CodeBlock { "M3"; }
count_40 = List.Count(list=watch_22)
ofRepeatedItem_33 = List.OfRepeatedItem(item=code_block_219, amount=count_40)
# note: 터파기 물량ㅈ에서 콘크리트, 린 기둥 물량 빼기
code_block_220 = CodeBlock(FuncValues=code_block_218, FuncValuesUnit=ofRepeatedItem_33)  # same code as code_block_18
value_for_import_from_others_21 = CodeBlock(슬라브형상=value_for_import_from_others_19.RefInput3) { 슬라브형상; }
flatten_42 = List.Flatten(list=value_for_import_from_others_21)
doesIntersect_3 = Geometry.DoesIntersect(geometry=flatten_41, other=flatten_42, lacing=CrossProduct)
filterByBoolMask_2 = List.FilterByBoolMask(list=flatten_42, mask=doesIntersect_3@L2)
flatten_43 = List.Flatten(list=filterByBoolMask_2.in)

# group: Output Manager
reference_output_18 = CodeBlock { ref; }  # unwired: ref
output_18 = CodeBlock(MainOutput=code_block_220) { MainOutput; RefOutput_geoColor; }  # unwired: RefOutput_geoColor

# group: Input Manager
value_for_import_from_others_22 = CodeBlock(MainInput=code_block_13) { MainInput; RefInput1; RefInput2; }  # unwired: RefInput1, RefInput2

# group: <Func 7>Base Course
code_block_221 = CodeBlock { "TargetElements"; }
valueAtKey_50 = DesignScript.Builtin.Dictionary.ValueAtKey(dictionary=value_for_import_from_others_22.MainInput, key=code_block_221)
code_block_222 = CodeBlock { 300; 100; }
# note: <Func>
createBaseCourseSurfaces_3 = Custom[CreateBaseCourseSurfaces](Element=valueAtKey_50, BaseCourseOffsetBottom=code_block_222.out0, leanThick=code_block_222.out1)
area_11 = Surface.Area(surface=createBaseCourseSurfaces_3.Surface)
code_block_223 = CodeBlock(i=area_11) { Math.Round(List.Flatten(i)/1000000, 2); }
code_block_224 = CodeBlock { "M2"; }
count_41 = List.Count(list=code_block_223)
ofRepeatedItem_34 = List.OfRepeatedItem(item=code_block_224, amount=count_41)
code_block_225 = CodeBlock(FuncValues=code_block_223, FuncValuesUnit=ofRepeatedItem_34)  # same code as code_block_18

# group: Output Manager
output_19 = CodeBlock(MainOutput=code_block_225) { MainOutput; RefOutput_geoColor; }  # unwired: RefOutput_geoColor
reference_output_19 = CodeBlock(ref=createBaseCourseSurfaces_3.Surface) { ref; }

# group: Input Manager
value_for_import_from_others_23 = CodeBlock(MainInput=code_block_13, RefInput1=reference_output_19) { MainInput; RefInput1; RefInput2; }  # unwired: RefInput2

# group: <Func 8>Crushed Stone
code_block_226 = CodeBlock { "TargetElements"; }
valueAtKey_51 = DesignScript.Builtin.Dictionary.ValueAtKey(dictionary=value_for_import_from_others_23.MainInput, key=code_block_226)
# note: <Func>
code_block_227 = CodeBlock { 300; 100; }
createBaseCourseSurfaces_4 = Custom[CreateBaseCourseSurfaces](Element=valueAtKey_51, BaseCourseOffsetBottom=code_block_227.out0, leanThick=code_block_227.out1)
boolean_2 = BoolSelector(false)
thicken = Surface.Thicken(surface=createBaseCourseSurfaces_4.Surface, thickness=code_block_227.out0, both_sides=boolean_2)
volume_12 = Solid.Volume(solid=thicken)
code_block_228 = CodeBlock(i=volume_12) { Math.Round(List.Flatten(i)/1000000000, 2); }
code_block_229 = CodeBlock { "M3"; }
count_42 = List.Count(list=code_block_228)
ofRepeatedItem_35 = List.OfRepeatedItem(item=code_block_229, amount=count_42)
code_block_230 = CodeBlock(FuncValues=code_block_228, FuncValuesUnit=ofRepeatedItem_35)  # same code as code_block_18

# group: Output Manager
reference_output_20 = CodeBlock { ref; }  # unwired: ref
output_20 = CodeBlock(MainOutput=code_block_230) { MainOutput; RefOutput_geoColor; }  # unwired: RefOutput_geoColor

# group: Input Manager
value_for_import_from_others_24 = CodeBlock(MainInput=code_block_13) { MainInput; RefInput1; RefInput2; }  # unwired: RefInput1, RefInput2

# group: <Func 10>Rebar Work
code_block_231 = CodeBlock { "TargetElements"; }
valueAtKey_52 = DesignScript.Builtin.Dictionary.ValueAtKey(dictionary=value_for_import_from_others_24.MainInput, key=code_block_231)
code_block_232 = CodeBlock { "Volume"; }
# note: <Func>
getParameterValueByName_9 = Element.GetParameterValueByName(element=valueAtKey_52, parameterName=code_block_232)
sog_철근비 = DoubleInput(0)  # graph input
mul_4 = getParameterValueByName_9 * sog_철근비
code_block_233 = CodeBlock(i=mul_4) { Math.Round(List.Flatten(i)/1, 2); }
code_block_234 = CodeBlock { "TON"; }
count_43 = List.Count(list=code_block_233)
ofRepeatedItem_36 = List.OfRepeatedItem(item=code_block_234, amount=count_43)
code_block_235 = CodeBlock(FuncValues=code_block_233, FuncValuesUnit=ofRepeatedItem_36)  # same code as code_block_18

# group: Output Manager
reference_output_21 = CodeBlock { ref; }  # unwired: ref
output_21 = CodeBlock(MainOutput=code_block_235) { MainOutput; RefOutput_geoColor; }  # unwired: RefOutput_geoColor

join_4 = List.Join(list0=output_13.MainOutput, list1=output_15.MainOutput, list2=output_16.MainOutput, list3=output_17.MainOutput, list4=output_2.MainOutput, list5=output_18.MainOutput, list6=output_14.MainOutput, list7=output_19.MainOutput, list8=output_20.MainOutput, list9=output.MainOutput, list10=output_21.MainOutput)

# group: Select Target Family Element And Connected WorkMasters
code_block_236 = CodeBlock { 1; }
select_target_family_element_and_2 = Python(IN[0]=set_up_all_element_inform_as, IN[1]=code_block_236)  # "Select Target Family Element And Connected WorkMasters"; CPython3; same code as select_target_family_element_and

watch_23 = Watch(select_target_family_element_and_2)
code_block_237 = CodeBlock(i=watch_23) { i; }

# group: TargetWMunique + Data Sending
code_block_238 = CodeBlock(InputDic2=join_4) { _InputDic2; }
count_44 = List.Count(list=code_block_238)
code_block_239 = CodeBlock(InputDic1=code_block_237) { _InputDic1; }
code_block_240 = CodeBlock { "TargetWMunique"; }
valueAtKey_53 = DesignScript.Builtin.Dictionary.ValueAtKey(dictionary=code_block_239, key=code_block_240)
watch_24 = Watch(valueAtKey_53)
count_45 = List.Count(list=watch_24)
eq_4 = count_44 == count_45
organizeFuncValuesAndWorkMasterAsDiction_4 = Custom[OrganizeFuncValuesAndWorkMasterAsDictionary](InputDic1=code_block_239, InputDic2=code_block_238)
watch_25 = Watch()  # unwired: arg0
if_9 = If(test=eq_4, true=organizeFuncValuesAndWorkMasterAsDiction_4, false=watch_25)

watch_26 = Watch(output_2.MainOutput)

# group: 하위분개
keys_2 = DesignScript.Builtin.Dictionary.Keys()  # unwired: dictionary
code_block_241 = CodeBlock(i=keys_2) { i; }
valueAtKey_54 = DesignScript.Builtin.Dictionary.ValueAtKey(key=keys_2)  # unwired: dictionary
code_block_242 = CodeBlock { -1; }
dropItems_2 = List.DropItems(list=valueAtKey_54, amount=code_block_242)
code_block_243 = CodeBlock { 0; }
code_block_244 = CodeBlock(i=dropItems_2) { i[0]; i[1]; i[2]; }
flatten_44 = List.Flatten(list=code_block_244.out0)
replaceItemAtIndex_4 = List.ReplaceItemAtIndex(list=dropItems_2, index=code_block_243, item=flatten_44)
code_block_245 = CodeBlock { 1; }
flatten_45 = List.Flatten(list=code_block_244.out1@L2)
replaceItemAtIndex_5 = List.ReplaceItemAtIndex(list=replaceItemAtIndex_4, index=code_block_245, item=flatten_45)
code_block_246 = CodeBlock { 2; }
flatten_46 = List.Flatten(list=code_block_244.out2)
replaceItemAtIndex_6 = List.ReplaceItemAtIndex(list=replaceItemAtIndex_5, index=code_block_246, item=flatten_46)
분개_index_입력_2 = CodeBlock { [1,2,3]; }
getItemAtIndex_2 = List.GetItemAtIndex(list=replaceItemAtIndex_6@L3, index=분개_index_입력_2)
code_block_247 = CodeBlock(i=getItemAtIndex_2) { i[1]; }
flatten_47 = List.Flatten(list=code_block_247)
uniqueItems_3 = List.UniqueItems(list=flatten_47)
addItemToEnd_2 = List.AddItemToEnd(item=uniqueItems_3, list=getItemAtIndex_2)
byKeysValues_4 = DesignScript.Builtin.Dictionary.ByKeysValues(keys=code_block_241, values=addItemToEnd_2)

code_block_248 = CodeBlock(i=byKeysValues_4) { i; }

# group: Input Manager
value_for_import_from_others_25 = CodeBlock(MainInput=code_block_248) { MainInput; RefInput1; RefInput2; }  # unwired: RefInput1, RefInput2

# group: <Func 9>Lean Concrete
code_block_249 = CodeBlock { "TargetElements"; }
valueAtKey_55 = DesignScript.Builtin.Dictionary.ValueAtKey(dictionary=value_for_import_from_others_25.MainInput, key=code_block_249)
code_block_250 = CodeBlock { 0; 100; }
# note: <Func>
createLeanConcrete_7 = Custom[CreateLeanConcrete](Element=valueAtKey_55, leanOffset=code_block_250.out0, leanThick=code_block_250.out1)
volume_13 = Solid.Volume(solid=createLeanConcrete_7.Solid)
code_block_251 = CodeBlock(i=volume_13) { Math.Round(List.Flatten(i)/1000000000, 2); }
code_block_252 = CodeBlock { "M3"; }
count_46 = List.Count(list=code_block_251)
ofRepeatedItem_37 = List.OfRepeatedItem(item=code_block_252, amount=count_46)
code_block_253 = CodeBlock(FuncValues=code_block_251, FuncValuesUnit=ofRepeatedItem_37)  # same code as code_block_18

# group: Output Manager
reference_output_22 = CodeBlock(ref=createLeanConcrete_7.Solid) { ref; }
output_22 = CodeBlock(MainOutput=code_block_253, RefOutput_geoColor=createLeanConcrete_7.Solid) { MainOutput; RefOutput_geoColor; }

# group: Input Manager
value_for_import_from_others_26 = CodeBlock(MainInput=code_block_248, RefInput1=reference_output_22) { MainInput; RefInput1; RefInput2; }  # unwired: RefInput2

# group: <Func 4> Excavation (SOG 한정)
flatten_48 = List.Flatten(list=value_for_import_from_others_26.RefInput1)
하부_surface_추출_5 = Python(IN[0]=flatten_48)  # CPython3; same code as 하부_surface_추출
flatten_49 = List.Flatten(list=하부_surface_추출_5)
perimeterCurves_4 = Surface.PerimeterCurves(surface=flatten_49)
byJoinedCurves_4 = PolyCurve.ByJoinedCurves(curves=perimeterCurves_4)
code_block_254 = CodeBlock { _ExcavOffsetBottom: var[]..[] = 300; }
offset_7 = Curve.Offset(curve=byJoinedCurves_4, distance=code_block_254)
flatten_50 = List.Flatten(list=offset_7)
levels_4 = Levels("G.L")  # graph input
elevation_4 = Level.Elevation(level=levels_4)
code_block_255 = CodeBlock { "TargetElements"; }
valueAtKey_56 = DesignScript.Builtin.Dictionary.ValueAtKey(dictionary=value_for_import_from_others_26.MainInput, key=code_block_255)
code_block_256 = CodeBlock { "Elevation at Bottom"; }
getParameterValueByName_10 = Element.GetParameterValueByName(element=valueAtKey_56, parameterName=code_block_256)
린_콘크리트_하부까지의_길이_추출_최하단_4 = Python(IN[0]=value_for_import_from_others_26.RefInput1)  # CPython3; same code as 린_콘크리트_하부까지의_길이_추출_최하단
code_block_257 = CodeBlock(기초하단=getParameterValueByName_10, 린콘크리트하단=린_콘크리트_하부까지의_길이_추출_최하단_4) { 기초하단-린콘크리트하단; }
sub_4 = elevation_4 - code_block_257
flatten_51 = List.Flatten(list=sub_4)
translate_4 = Geometry.Translate(geometry=offset_7, zTranslation=flatten_51)
경사_비율_입력_1_x_for_isofdn_3 = DoubleInput(2)  # graph input
code_block_258 = CodeBlock(ElevationatBottom=flatten_51, 비율=경사_비율_입력_1_x_for_isofdn_3) { ElevationatBottom/비율; }
offset_8 = Curve.Offset(curve=translate_4, distance=code_block_258)
flatten_52 = List.Flatten(list=offset_8)
list_create_8 = List.Create(item0=flatten_50, item1=flatten_52)
transpose_8 = List.Transpose(lists=list_create_8)
byLoft_4 = Solid.ByLoft(crossSections=transpose_8)
터파기_형상_겹침_해소_4 = Python(IN[0]=byLoft_4)  # CPython3; same code as 터파기_형상_겹침_해소
code_block_259 = CodeBlock(i=sub_4) { i<0?true:false; }
code_block_260 = CodeBlock { 0; }
volume_14 = Solid.Volume(solid=터파기_형상_겹침_해소_4)
code_block_261 = CodeBlock(i=volume_14) { Math.Round(List.Flatten(i)/1000000000, 2); }
if_10 = If(test=code_block_259, true=code_block_260, false=code_block_261)
code_block_262 = CodeBlock { "M3"; }
count_47 = List.Count(list=code_block_261)
ofRepeatedItem_38 = List.OfRepeatedItem(item=code_block_262, amount=count_47)
code_block_263 = CodeBlock(FuncValues=if_10, FuncValuesUnit=ofRepeatedItem_38)  # same code as code_block_18
color_palette_6 = ColorPalette({R: 210, G: 105, B: 30, A: 135})
byGeometryColor_6 = Modifiers.GeometryColor.ByGeometryColor(geometry=터파기_형상_겹침_해소_4, color=color_palette_6)
forRefOutput_4 = CodeBlock(MainOutput=code_block_263, geoColor=byGeometryColor_6, 터파기형상=터파기_형상_겹침_해소_4)  # same code as forRefOutput

# group: Output Manager
reference_output_23 = CodeBlock(ref=터파기_형상_겹침_해소_4, ref2=if_10) { ref; ref2; }
output_23 = CodeBlock(MainOutput=forRefOutput_4, RefOutput_geoColor=byGeometryColor_6) { MainOutput; RefOutput_geoColor; }

# group: Input Manager
value_for_import_from_others_27 = CodeBlock(MainInput=code_block_248, RefInput1=reference_output_23.ref2) { MainInput; RefInput1; RefInput2; }  # unwired: RefInput2

# group: <Func 6>Disposal
code_block_264 = CodeBlock { "TargetElements"; }
valueAtKey_57 = DesignScript.Builtin.Dictionary.ValueAtKey(dictionary=value_for_import_from_others_27.MainInput, key=code_block_264)
count_48 = List.Count(list=valueAtKey_57@L1)
code_block_265 = CodeBlock(i=value_for_import_from_others_27.RefInput1) { i==0?true:false; }
code_block_266 = CodeBlock { 0; }
# note: <Func>
if_11 = If(test=code_block_265, true=code_block_266, false=value_for_import_from_others_27.RefInput1)
code_block_267 = CodeBlock(i=if_11) { Math.Round(List.Flatten(i)/1000000000, 2); }
code_block_268 = CodeBlock { "M3"; }
count_49 = List.Count(list=code_block_267)
ofRepeatedItem_39 = List.OfRepeatedItem(item=code_block_268, amount=count_49)
code_block_269 = CodeBlock(FuncValues=code_block_267, FuncValuesUnit=ofRepeatedItem_39)  # same code as code_block_18

# group: Input Manager
value_for_import_from_others_28 = CodeBlock(MainInput=code_block_248) { MainInput; RefInput1; RefInput2; }  # unwired: RefInput1, RefInput2

# group: <Func 0> Hardner Finish (상부면)
code_block_270 = CodeBlock { "TargetElements"; }
# note: <Func>
valueAtKey_58 = DesignScript.Builtin.Dictionary.ValueAtKey(dictionary=value_for_import_from_others_28.MainInput, key=code_block_270)
flatten_53 = List.Flatten(list=valueAtKey_58)
# note: 일반화 여지가 있음
# (형상처리구간 + 물량계산 + 데이터 매칭)
extractUpperFacesOfElement_4 = Custom[ExtractUpperFacesOfElement](Element=flatten_53)
area_12 = Surface.Area(surface=extractUpperFacesOfElement_4.Surface)
sum_6 = Math.Sum(values=area_12)
code_block_271 = CodeBlock(i=sum_6) { Math.Round(List.Flatten(i)/1000000, 2); }
code_block_272 = CodeBlock { "M2"; }
count_50 = List.Count(list=code_block_271)
ofRepeatedItem_40 = List.OfRepeatedItem(item=code_block_272, amount=count_50)
code_block_273 = CodeBlock(FuncValues=code_block_271, FuncValuesUnit=ofRepeatedItem_40)  # same code as code_block_18
color_palette_7 = ColorPalette({R: 30, G: 144, B: 255, A: 129})
byGeometryColor_7 = Modifiers.GeometryColor.ByGeometryColor(geometry=extractUpperFacesOfElement_4.Surface, color=color_palette_7)

# group: Output Manager
reference_output_24 = CodeBlock { ref; }  # unwired: ref
output_24 = CodeBlock(MainOutput=code_block_273, RefOutput_geoColor=byGeometryColor_7) { MainOutput; RefOutput_geoColor; }

# group: <Func 6> Visual Manager
visual_켜기_끄기_9 = BoolSelector(false)
visual_manager_9 = Python(IN[0]=output_24.RefOutput_geoColor, IN[1]=visual_켜기_끄기_9)  # CPython3; same code as visual_manager

# group: Visual Manager
visual_켜기_끄기_10 = BoolSelector(false)
visual_manager_10 = Python(IN[0]=output_23.RefOutput_geoColor, IN[1]=visual_켜기_끄기_10)  # CPython3; same code as visual_manager

# group: Output Manager
reference_output_25 = CodeBlock { ref; }  # unwired: ref
output_25 = CodeBlock(MainOutput=code_block_269) { MainOutput; RefOutput_geoColor; }  # unwired: RefOutput_geoColor

# group: Input Manager
value_for_import_from_others_29 = CodeBlock(MainInput=code_block_248) { MainInput; RefInput1; RefInput2; }  # unwired: RefInput1, RefInput2

# group: <Func 1> Structural Concrete
code_block_274 = CodeBlock { "TargetElements"; }
valueAtKey_59 = DesignScript.Builtin.Dictionary.ValueAtKey(dictionary=value_for_import_from_others_29.MainInput, key=code_block_274)
# note: <Func>
geometry_4 = Element.Geometry(element=valueAtKey_59)
volume_15 = Solid.Volume(solid=geometry_4)
code_block_275 = CodeBlock(i=volume_15) { Math.Round(List.Flatten(i)/1000000000,2); }
code_block_276 = CodeBlock { "M3"; }
count_51 = List.Count(list=code_block_275)
ofRepeatedItem_41 = List.OfRepeatedItem(item=code_block_276, amount=count_51)
code_block_277 = CodeBlock(FuncValues=code_block_275, FuncValuesUnit=ofRepeatedItem_41)  # same code as code_block_18

# group: Output Manager
reference_output_26 = CodeBlock(ref=geometry_4) { ref; }
output_26 = CodeBlock(MainOutput=code_block_277) { MainOutput; RefOutput_geoColor; }  # unwired: RefOutput_geoColor

# group: Input Manager
value_for_import_from_others_30 = CodeBlock(MainInput=code_block_248, RefInput1=reference_output_22, RefInput2=reference_output_23.ref, RefInput3=reference_output_26) { MainInput; RefInput1; RefInput2; RefInput3; }

# group: <Func 2> Backfill
value_for_import_from_others_31 = CodeBlock(슬라브형상=value_for_import_from_others_30.RefInput3) { 슬라브형상; }
flatten_54 = List.Flatten(list=value_for_import_from_others_31)
value_for_import_from_others_32 = CodeBlock(터파기형상=value_for_import_from_others_30.RefInput2) { 터파기형상; }
flatten_55 = List.Flatten(list=value_for_import_from_others_32)
doesIntersect_4 = Geometry.DoesIntersect(geometry=flatten_55, other=flatten_54, lacing=CrossProduct)
filterByBoolMask_3 = List.FilterByBoolMask(list=flatten_54, mask=doesIntersect_4@L2)
flatten_56 = List.Flatten(list=filterByBoolMask_3.in)
volume_16 = Solid.Volume(solid=flatten_55)
watch_27 = Watch(volume_16)
code_block_278 = CodeBlock(i=watch_27) { Math.Round(List.Flatten(i)/1000000000, 2); }
code_block_279 = CodeBlock { "M3"; }
count_52 = List.Count(list=watch_27)
ofRepeatedItem_42 = List.OfRepeatedItem(item=code_block_279, amount=count_52)
# note: 터파기 물량ㅈ에서 콘크리트, 린 기둥 물량 빼기
code_block_280 = CodeBlock(FuncValues=code_block_278, FuncValuesUnit=ofRepeatedItem_42)  # same code as code_block_18

# group: Output Manager
reference_output_27 = CodeBlock { ref; }  # unwired: ref
output_27 = CodeBlock(MainOutput=code_block_280) { MainOutput; RefOutput_geoColor; }  # unwired: RefOutput_geoColor

watch_28 = Watch(output_23.MainOutput)

# group: Visual Manager
visual_켜기_끄기_11 = BoolSelector(false)
visual_manager_11 = Python(IN[0]=output_22.RefOutput_geoColor, IN[1]=visual_켜기_끄기_11)  # CPython3; same code as visual_manager

# group: Input Manager
value_for_import_from_others_33 = CodeBlock(MainInput=code_block_248) { MainInput; RefInput1; RefInput2; }  # unwired: RefInput1, RefInput2

# group: <Func 2> Form Works (Ground Slab 거푸집 필요X)
code_block_281 = CodeBlock { "TargetElements"; }
valueAtKey_60 = DesignScript.Builtin.Dictionary.ValueAtKey(dictionary=value_for_import_from_others_33.MainInput, key=code_block_281)
code_block_282 = CodeBlock { "Volume"; }
# note: <Func>
getParameterValueByName_11 = Element.GetParameterValueByName(element=valueAtKey_60, parameterName=code_block_282)
code_block_283 = CodeBlock(i=getParameterValueByName_11) { Math.Round(List.Flatten(i)/10000000,2); }
code_block_284 = CodeBlock { "M3"; }
count_53 = List.Count(list=code_block_283)
ofRepeatedItem_43 = List.OfRepeatedItem(item=code_block_284, amount=count_53)
code_block_285 = CodeBlock(FuncValues=code_block_283, FuncValuesUnit=ofRepeatedItem_43)  # same code as code_block_18

# group: Output Manager
reference_output_28 = CodeBlock { ref; }  # unwired: ref
output_28 = CodeBlock(MainOutput=code_block_285) { MainOutput; RefOutput_geoColor; }  # unwired: RefOutput_geoColor

# group: Input Manager
value_for_import_from_others_34 = CodeBlock(MainInput=code_block_248) { MainInput; RefInput1; RefInput2; }  # unwired: RefInput1, RefInput2

# group: <Func 3> PE Sheet
code_block_286 = CodeBlock { "TargetElements"; }
valueAtKey_61 = DesignScript.Builtin.Dictionary.ValueAtKey(dictionary=value_for_import_from_others_34.MainInput, key=code_block_286)
# note: <Func>
createLeanConcrete_8 = Custom[CreateLeanConcrete](Element=valueAtKey_61)
area_13 = Surface.Area(surface=createLeanConcrete_8.Surface)
code_block_287 = CodeBlock(i=area_13) { Math.Round(List.Flatten(i)/1000000, 2); }
code_block_288 = CodeBlock { "M2"; }
count_54 = List.Count(list=code_block_287)
ofRepeatedItem_44 = List.OfRepeatedItem(item=code_block_288, amount=count_54)
code_block_289 = CodeBlock(FuncValues=code_block_287, FuncValuesUnit=ofRepeatedItem_44)  # same code as code_block_18

# group: Output Manager
reference_output_29 = CodeBlock { ref; }  # unwired: ref
output_29 = CodeBlock(MainOutput=code_block_289) { MainOutput; RefOutput_geoColor; }  # unwired: RefOutput_geoColor

# group: Input Manager
value_for_import_from_others_35 = CodeBlock(MainInput=code_block_248) { MainInput; RefInput1; RefInput2; }  # unwired: RefInput1, RefInput2

# group: <Func 7>Base Course
code_block_290 = CodeBlock { "TargetElements"; }
valueAtKey_62 = DesignScript.Builtin.Dictionary.ValueAtKey(dictionary=value_for_import_from_others_35.MainInput, key=code_block_290)
code_block_291 = CodeBlock { 300; 100; }
# note: <Func>
createBaseCourseSurfaces_5 = Custom[CreateBaseCourseSurfaces](Element=valueAtKey_62, BaseCourseOffsetBottom=code_block_291.out0, leanThick=code_block_291.out1)
area_14 = Surface.Area(surface=createBaseCourseSurfaces_5.Surface)
code_block_292 = CodeBlock(i=area_14) { Math.Round(List.Flatten(i)/1000000, 2); }
code_block_293 = CodeBlock { "M2"; }
count_55 = List.Count(list=code_block_292)
ofRepeatedItem_45 = List.OfRepeatedItem(item=code_block_293, amount=count_55)
code_block_294 = CodeBlock(FuncValues=code_block_292, FuncValuesUnit=ofRepeatedItem_45)  # same code as code_block_18

# group: Output Manager
output_30 = CodeBlock(MainOutput=code_block_294) { MainOutput; RefOutput_geoColor; }  # unwired: RefOutput_geoColor
reference_output_30 = CodeBlock(ref=createBaseCourseSurfaces_5.Surface) { ref; }

# group: Input Manager
value_for_import_from_others_36 = CodeBlock(MainInput=code_block_248, RefInput1=reference_output_30) { MainInput; RefInput1; RefInput2; }  # unwired: RefInput2

# group: <Func 8>Crushed Stone
code_block_295 = CodeBlock { "TargetElements"; }
valueAtKey_63 = DesignScript.Builtin.Dictionary.ValueAtKey(dictionary=value_for_import_from_others_36.MainInput, key=code_block_295)
# note: <Func>
code_block_296 = CodeBlock { 300; 100; }
createBaseCourseSurfaces_6 = Custom[CreateBaseCourseSurfaces](Element=valueAtKey_63, BaseCourseOffsetBottom=code_block_296.out0, leanThick=code_block_296.out1)
boolean_3 = BoolSelector(false)
thicken_2 = Surface.Thicken(surface=createBaseCourseSurfaces_6.Surface, thickness=code_block_296.out0, both_sides=boolean_3)
volume_17 = Solid.Volume(solid=thicken_2)
code_block_297 = CodeBlock(i=volume_17) { Math.Round(List.Flatten(i)/1000000000, 2); }
code_block_298 = CodeBlock { "M3"; }
count_56 = List.Count(list=code_block_297)
ofRepeatedItem_46 = List.OfRepeatedItem(item=code_block_298, amount=count_56)
code_block_299 = CodeBlock(FuncValues=code_block_297, FuncValuesUnit=ofRepeatedItem_46)  # same code as code_block_18

# group: Output Manager
reference_output_31 = CodeBlock { ref; }  # unwired: ref
output_31 = CodeBlock(MainOutput=code_block_299) { MainOutput; RefOutput_geoColor; }  # unwired: RefOutput_geoColor

# group: Input Manager
value_for_import_from_others_37 = CodeBlock(MainInput=code_block_248) { MainInput; RefInput1; RefInput2; }  # unwired: RefInput1, RefInput2

# group: <Func 10>Rebar Work
code_block_300 = CodeBlock { "TargetElements"; }
valueAtKey_64 = DesignScript.Builtin.Dictionary.ValueAtKey(dictionary=value_for_import_from_others_37.MainInput, key=code_block_300)
code_block_301 = CodeBlock { "Volume"; }
# note: <Func>
getParameterValueByName_12 = Element.GetParameterValueByName(element=valueAtKey_64, parameterName=code_block_301)
sog_철근비_2 = DoubleInput(0)  # graph input
mul_5 = getParameterValueByName_12 * sog_철근비_2
code_block_302 = CodeBlock(i=mul_5) { Math.Round(List.Flatten(i)/1, 2); }
code_block_303 = CodeBlock { "TON"; }
count_57 = List.Count(list=code_block_302)
ofRepeatedItem_47 = List.OfRepeatedItem(item=code_block_303, amount=count_57)
code_block_304 = CodeBlock(FuncValues=code_block_302, FuncValuesUnit=ofRepeatedItem_47)  # same code as code_block_18

# group: Output Manager
reference_output_32 = CodeBlock { ref; }  # unwired: ref
output_32 = CodeBlock(MainOutput=code_block_304) { MainOutput; RefOutput_geoColor; }  # unwired: RefOutput_geoColor

join_5 = List.Join(list0=output_24.MainOutput, list1=output_26.MainOutput, list2=output_28.MainOutput, list3=output_29.MainOutput, list4=output_23.MainOutput, list5=output_27.MainOutput, list6=output_25.MainOutput, list7=output_30.MainOutput, list8=output_31.MainOutput, list9=output_22.MainOutput, list10=output_32.MainOutput)

# group: TargetWMunique + Data Sending
code_block_305 = CodeBlock(InputDic2=join_5) { _InputDic2; }
count_58 = List.Count(list=code_block_305)
code_block_306 = CodeBlock(InputDic1=code_block_237) { _InputDic1; }
code_block_307 = CodeBlock { "TargetWMunique"; }
valueAtKey_65 = DesignScript.Builtin.Dictionary.ValueAtKey(dictionary=code_block_306, key=code_block_307)
watch_29 = Watch(valueAtKey_65)
count_59 = List.Count(list=watch_29)
eq_5 = count_58 == count_59
organizeFuncValuesAndWorkMasterAsDiction_5 = Custom[OrganizeFuncValuesAndWorkMasterAsDictionary](InputDic1=code_block_306, InputDic2=code_block_305)
watch_30 = Watch()  # unwired: arg0
if_12 = If(test=eq_5, true=organizeFuncValuesAndWorkMasterAsDiction_5, false=watch_30)

code_block_308 = CodeBlock { i; }  # unwired: i

# group: Input Manager
value_for_import_from_others_38 = CodeBlock(MainInput=code_block_308) { MainInput; RefInput1; RefInput2; }  # unwired: RefInput1, RefInput2

# group: <Func 9>Lean Concrete
code_block_309 = CodeBlock { "TargetElements"; }
valueAtKey_66 = DesignScript.Builtin.Dictionary.ValueAtKey(dictionary=value_for_import_from_others_38.MainInput, key=code_block_309)
code_block_310 = CodeBlock { 0; 100; }
# note: <Func>
createLeanConcrete_9 = Custom[CreateLeanConcrete](Element=valueAtKey_66, leanOffset=code_block_310.out0, leanThick=code_block_310.out1)
volume_18 = Solid.Volume(solid=createLeanConcrete_9.Solid)
code_block_311 = CodeBlock(i=volume_18) { Math.Round(List.Flatten(i)/1000000000, 2); }
code_block_312 = CodeBlock { "M3"; }
count_60 = List.Count(list=code_block_311)
ofRepeatedItem_48 = List.OfRepeatedItem(item=code_block_312, amount=count_60)
code_block_313 = CodeBlock(FuncValues=code_block_311, FuncValuesUnit=ofRepeatedItem_48)  # same code as code_block_18

# group: Output Manager
reference_output_33 = CodeBlock(ref=createLeanConcrete_9.Solid) { ref; }
output_33 = CodeBlock(MainOutput=code_block_313, RefOutput_geoColor=createLeanConcrete_9.Solid) { MainOutput; RefOutput_geoColor; }

# group: Input Manager
value_for_import_from_others_39 = CodeBlock(MainInput=code_block_308, RefInput1=reference_output_33) { MainInput; RefInput1; RefInput2; }  # unwired: RefInput2

# group: <Func 4> Excavation (SOG 한정)
levels_5 = Levels("G.L")  # graph input
elevation_5 = Level.Elevation(level=levels_5)
code_block_314 = CodeBlock { "TargetElements"; }
valueAtKey_67 = DesignScript.Builtin.Dictionary.ValueAtKey(dictionary=value_for_import_from_others_39.MainInput, key=code_block_314)
code_block_315 = CodeBlock { "Elevation at Bottom"; }
getParameterValueByName_13 = Element.GetParameterValueByName(element=valueAtKey_67, parameterName=code_block_315)
린_콘크리트_하부까지의_길이_추출_최하단_5 = Python(IN[0]=value_for_import_from_others_39.RefInput1)  # CPython3; same code as 린_콘크리트_하부까지의_길이_추출_최하단
code_block_316 = CodeBlock(기초하단=getParameterValueByName_13, 린콘크리트하단=린_콘크리트_하부까지의_길이_추출_최하단_5) { 기초하단-린콘크리트하단; }
sub_5 = elevation_5 - code_block_316
code_block_317 = CodeBlock(i=sub_5) { i<0?true:false; }
code_block_318 = CodeBlock { 0; }
flatten_57 = List.Flatten(list=value_for_import_from_others_39.RefInput1)
하부_surface_추출_6 = Python(IN[0]=flatten_57)  # CPython3; same code as 하부_surface_추출
flatten_58 = List.Flatten(list=하부_surface_추출_6)
perimeterCurves_5 = Surface.PerimeterCurves(surface=flatten_58)
byJoinedCurves_5 = PolyCurve.ByJoinedCurves(curves=perimeterCurves_5)
code_block_319 = CodeBlock { _ExcavOffsetBottom: var[]..[] = 300; }
offset_9 = Curve.Offset(curve=byJoinedCurves_5, distance=code_block_319)
flatten_59 = List.Flatten(list=offset_9)
flatten_60 = List.Flatten(list=sub_5)
translate_5 = Geometry.Translate(geometry=offset_9, zTranslation=flatten_60)
경사_비율_입력_1_x_for_isofdn_4 = DoubleInput(2)  # graph input
code_block_320 = CodeBlock(ElevationatBottom=flatten_60, 비율=경사_비율_입력_1_x_for_isofdn_4) { ElevationatBottom/비율; }
offset_10 = Curve.Offset(curve=translate_5, distance=code_block_320)
flatten_61 = List.Flatten(list=offset_10)
list_create_9 = List.Create(item0=flatten_59, item1=flatten_61)
transpose_9 = List.Transpose(lists=list_create_9)
byLoft_5 = Solid.ByLoft(crossSections=transpose_9)
터파기_형상_겹침_해소_5 = Python(IN[0]=byLoft_5)  # CPython3; same code as 터파기_형상_겹침_해소
volume_19 = Solid.Volume(solid=터파기_형상_겹침_해소_5)
code_block_321 = CodeBlock(i=volume_19) { Math.Round(List.Flatten(i)/1000000000, 2); }
if_13 = If(test=code_block_317, true=code_block_318, false=code_block_321)
code_block_322 = CodeBlock { "M3"; }
count_61 = List.Count(list=code_block_321)
ofRepeatedItem_49 = List.OfRepeatedItem(item=code_block_322, amount=count_61)
code_block_323 = CodeBlock(FuncValues=if_13, FuncValuesUnit=ofRepeatedItem_49)  # same code as code_block_18
color_palette_8 = ColorPalette({R: 210, G: 105, B: 30, A: 135})
byGeometryColor_8 = Modifiers.GeometryColor.ByGeometryColor(geometry=터파기_형상_겹침_해소_5, color=color_palette_8)
forRefOutput_5 = CodeBlock(MainOutput=code_block_323, geoColor=byGeometryColor_8, 터파기형상=터파기_형상_겹침_해소_5)  # same code as forRefOutput

# group: Output Manager
output_34 = CodeBlock(MainOutput=forRefOutput_5, RefOutput_geoColor=byGeometryColor_8) { MainOutput; RefOutput_geoColor; }
reference_output_34 = CodeBlock(ref=터파기_형상_겹침_해소_5, ref2=if_13) { ref; ref2; }

# group: Visual Manager
visual_켜기_끄기_12 = BoolSelector(false)
visual_manager_12 = Python(IN[0]=output_34.RefOutput_geoColor, IN[1]=visual_켜기_끄기_12)  # CPython3; same code as visual_manager

watch_31 = Watch(output_34.MainOutput)

# group: Visual Manager
visual_켜기_끄기_13 = BoolSelector(false)
visual_manager_13 = Python(IN[0]=output_33.RefOutput_geoColor, IN[1]=visual_켜기_끄기_13)  # CPython3; same code as visual_manager

# group: Input Manager
value_for_import_from_others_40 = CodeBlock(MainInput=code_block_308) { MainInput; RefInput1; RefInput2; }  # unwired: RefInput1, RefInput2

# group: <Func 0> Hardner Finish (상부면)
code_block_324 = CodeBlock { "TargetElements"; }
# note: <Func>
valueAtKey_68 = DesignScript.Builtin.Dictionary.ValueAtKey(dictionary=value_for_import_from_others_40.MainInput, key=code_block_324)
flatten_62 = List.Flatten(list=valueAtKey_68)
# note: 일반화 여지가 있음
# (형상처리구간 + 물량계산 + 데이터 매칭)
extractUpperFacesOfElement_5 = Custom[ExtractUpperFacesOfElement](Element=flatten_62)
area_15 = Surface.Area(surface=extractUpperFacesOfElement_5.Surface)
sum_7 = Math.Sum(values=area_15)
code_block_325 = CodeBlock(i=sum_7) { Math.Round(List.Flatten(i)/1000000, 2); }
code_block_326 = CodeBlock { "M2"; }
count_62 = List.Count(list=code_block_325)
ofRepeatedItem_50 = List.OfRepeatedItem(item=code_block_326, amount=count_62)
code_block_327 = CodeBlock(FuncValues=code_block_325, FuncValuesUnit=ofRepeatedItem_50)  # same code as code_block_18
color_palette_9 = ColorPalette({R: 30, G: 144, B: 255, A: 129})
byGeometryColor_9 = Modifiers.GeometryColor.ByGeometryColor(geometry=extractUpperFacesOfElement_5.Surface, color=color_palette_9)

# group: Output Manager
output_35 = CodeBlock(MainOutput=code_block_327, RefOutput_geoColor=byGeometryColor_9) { MainOutput; RefOutput_geoColor; }
reference_output_35 = CodeBlock { ref; }  # unwired: ref

# group: Input Manager
value_for_import_from_others_41 = CodeBlock(MainInput=code_block_308) { MainInput; RefInput1; RefInput2; }  # unwired: RefInput1, RefInput2

# group: <Func 1> Structural Concrete
code_block_328 = CodeBlock { "TargetElements"; }
valueAtKey_69 = DesignScript.Builtin.Dictionary.ValueAtKey(dictionary=value_for_import_from_others_41.MainInput, key=code_block_328)
# note: <Func>
geometry_5 = Element.Geometry(element=valueAtKey_69)
volume_20 = Solid.Volume(solid=geometry_5)
code_block_329 = CodeBlock(i=volume_20) { Math.Round(List.Flatten(i)/1000000000,2); }
code_block_330 = CodeBlock { "M3"; }
count_63 = List.Count(list=code_block_329)
ofRepeatedItem_51 = List.OfRepeatedItem(item=code_block_330, amount=count_63)
code_block_331 = CodeBlock(FuncValues=code_block_329, FuncValuesUnit=ofRepeatedItem_51)  # same code as code_block_18

# group: Output Manager
output_36 = CodeBlock(MainOutput=code_block_331) { MainOutput; RefOutput_geoColor; }  # unwired: RefOutput_geoColor
reference_output_36 = CodeBlock(ref=geometry_5) { ref; }

# group: Input Manager
value_for_import_from_others_42 = CodeBlock(MainInput=code_block_308) { MainInput; RefInput1; RefInput2; }  # unwired: RefInput1, RefInput2

# group: <Func 2> Form Works (Ground Slab 거푸집 필요X)
code_block_332 = CodeBlock { "TargetElements"; }
valueAtKey_70 = DesignScript.Builtin.Dictionary.ValueAtKey(dictionary=value_for_import_from_others_42.MainInput, key=code_block_332)
code_block_333 = CodeBlock { "Volume"; }
# note: <Func>
getParameterValueByName_14 = Element.GetParameterValueByName(element=valueAtKey_70, parameterName=code_block_333)
code_block_334 = CodeBlock(i=getParameterValueByName_14) { Math.Round(List.Flatten(i)/10000000,2); }
code_block_335 = CodeBlock { "M3"; }
count_64 = List.Count(list=code_block_334)
ofRepeatedItem_52 = List.OfRepeatedItem(item=code_block_335, amount=count_64)
code_block_336 = CodeBlock(FuncValues=code_block_334, FuncValuesUnit=ofRepeatedItem_52)  # same code as code_block_18

# group: Output Manager
output_37 = CodeBlock(MainOutput=code_block_336) { MainOutput; RefOutput_geoColor; }  # unwired: RefOutput_geoColor
reference_output_37 = CodeBlock { ref; }  # unwired: ref

# group: Input Manager
value_for_import_from_others_43 = CodeBlock(MainInput=code_block_308) { MainInput; RefInput1; RefInput2; }  # unwired: RefInput1, RefInput2

# group: <Func 3> PE Sheet
code_block_337 = CodeBlock { "TargetElements"; }
valueAtKey_71 = DesignScript.Builtin.Dictionary.ValueAtKey(dictionary=value_for_import_from_others_43.MainInput, key=code_block_337)
# note: <Func>
createLeanConcrete_10 = Custom[CreateLeanConcrete](Element=valueAtKey_71)
area_16 = Surface.Area(surface=createLeanConcrete_10.Surface)
code_block_338 = CodeBlock(i=area_16) { Math.Round(List.Flatten(i)/1000000, 2); }
code_block_339 = CodeBlock { "M2"; }
count_65 = List.Count(list=code_block_338)
ofRepeatedItem_53 = List.OfRepeatedItem(item=code_block_339, amount=count_65)
code_block_340 = CodeBlock(FuncValues=code_block_338, FuncValuesUnit=ofRepeatedItem_53)  # same code as code_block_18

# group: Output Manager
output_38 = CodeBlock(MainOutput=code_block_340) { MainOutput; RefOutput_geoColor; }  # unwired: RefOutput_geoColor
reference_output_38 = CodeBlock { ref; }  # unwired: ref

# group: Input Manager
value_for_import_from_others_44 = CodeBlock(MainInput=code_block_308, RefInput1=reference_output_33, RefInput2=reference_output_34.ref, RefInput3=reference_output_36) { MainInput; RefInput1; RefInput2; RefInput3; }

# group: <Func 2> Backfill
value_for_import_from_others_45 = CodeBlock(터파기형상=value_for_import_from_others_44.RefInput2) { 터파기형상; }
flatten_63 = List.Flatten(list=value_for_import_from_others_45)
volume_21 = Solid.Volume(solid=flatten_63)
watch_32 = Watch(volume_21)
code_block_341 = CodeBlock(i=watch_32) { Math.Round(List.Flatten(i)/1000000000, 2); }
code_block_342 = CodeBlock { "M3"; }
count_66 = List.Count(list=watch_32)
ofRepeatedItem_54 = List.OfRepeatedItem(item=code_block_342, amount=count_66)
# note: 터파기 물량ㅈ에서 콘크리트, 린 기둥 물량 빼기
code_block_343 = CodeBlock(FuncValues=code_block_341, FuncValuesUnit=ofRepeatedItem_54)  # same code as code_block_18
value_for_import_from_others_46 = CodeBlock(슬라브형상=value_for_import_from_others_44.RefInput3) { 슬라브형상; }
flatten_64 = List.Flatten(list=value_for_import_from_others_46)
doesIntersect_5 = Geometry.DoesIntersect(geometry=flatten_63, other=flatten_64, lacing=CrossProduct)
filterByBoolMask_4 = List.FilterByBoolMask(list=flatten_64, mask=doesIntersect_5@L2)
flatten_65 = List.Flatten(list=filterByBoolMask_4.in)

# group: Output Manager
output_39 = CodeBlock(MainOutput=code_block_343) { MainOutput; RefOutput_geoColor; }  # unwired: RefOutput_geoColor
reference_output_39 = CodeBlock { ref; }  # unwired: ref

# group: Input Manager
value_for_import_from_others_47 = CodeBlock(MainInput=code_block_308, RefInput1=reference_output_34.ref2) { MainInput; RefInput1; RefInput2; }  # unwired: RefInput2

# group: <Func 6>Disposal
code_block_344 = CodeBlock(i=value_for_import_from_others_47.RefInput1) { i==0?true:false; }
code_block_345 = CodeBlock { 0; }
# note: <Func>
if_14 = If(test=code_block_344, true=code_block_345, false=value_for_import_from_others_47.RefInput1)
code_block_346 = CodeBlock(i=if_14) { Math.Round(List.Flatten(i)/1000000000, 2); }
code_block_347 = CodeBlock { "M3"; }
count_67 = List.Count(list=code_block_346)
ofRepeatedItem_55 = List.OfRepeatedItem(item=code_block_347, amount=count_67)
code_block_348 = CodeBlock(FuncValues=code_block_346, FuncValuesUnit=ofRepeatedItem_55)  # same code as code_block_18
code_block_349 = CodeBlock { "TargetElements"; }
valueAtKey_72 = DesignScript.Builtin.Dictionary.ValueAtKey(dictionary=value_for_import_from_others_47.MainInput, key=code_block_349)
count_68 = List.Count(list=valueAtKey_72@L1)

# group: Output Manager
output_40 = CodeBlock(MainOutput=code_block_348) { MainOutput; RefOutput_geoColor; }  # unwired: RefOutput_geoColor
reference_output_40 = CodeBlock { ref; }  # unwired: ref

# group: Input Manager
value_for_import_from_others_48 = CodeBlock(MainInput=code_block_308) { MainInput; RefInput1; RefInput2; }  # unwired: RefInput1, RefInput2

# group: <Func 7>Base Course
code_block_350 = CodeBlock { "TargetElements"; }
valueAtKey_73 = DesignScript.Builtin.Dictionary.ValueAtKey(dictionary=value_for_import_from_others_48.MainInput, key=code_block_350)
code_block_351 = CodeBlock { 300; 100; }
# note: <Func>
createBaseCourseSurfaces_7 = Custom[CreateBaseCourseSurfaces](Element=valueAtKey_73, BaseCourseOffsetBottom=code_block_351.out0, leanThick=code_block_351.out1)
area_17 = Surface.Area(surface=createBaseCourseSurfaces_7.Surface)
code_block_352 = CodeBlock(i=area_17) { Math.Round(List.Flatten(i)/1000000, 2); }
code_block_353 = CodeBlock { "M2"; }
count_69 = List.Count(list=code_block_352)
ofRepeatedItem_56 = List.OfRepeatedItem(item=code_block_353, amount=count_69)
code_block_354 = CodeBlock(FuncValues=code_block_352, FuncValuesUnit=ofRepeatedItem_56)  # same code as code_block_18

# group: Output Manager
output_41 = CodeBlock(MainOutput=code_block_354) { MainOutput; RefOutput_geoColor; }  # unwired: RefOutput_geoColor
reference_output_41 = CodeBlock(ref=createBaseCourseSurfaces_7.Surface) { ref; }

# group: Input Manager
value_for_import_from_others_49 = CodeBlock(MainInput=code_block_308, RefInput1=reference_output_41) { MainInput; RefInput1; RefInput2; }  # unwired: RefInput2

# group: <Func 8>Crushed Stone
code_block_355 = CodeBlock { "TargetElements"; }
valueAtKey_74 = DesignScript.Builtin.Dictionary.ValueAtKey(dictionary=value_for_import_from_others_49.MainInput, key=code_block_355)
# note: <Func>
code_block_356 = CodeBlock { 300; 100; }
createBaseCourseSurfaces_8 = Custom[CreateBaseCourseSurfaces](Element=valueAtKey_74, BaseCourseOffsetBottom=code_block_356.out0, leanThick=code_block_356.out1)
boolean_4 = BoolSelector(false)
thicken_3 = Surface.Thicken(surface=createBaseCourseSurfaces_8.Surface, thickness=code_block_356.out0, both_sides=boolean_4)
volume_22 = Solid.Volume(solid=thicken_3)
code_block_357 = CodeBlock(i=volume_22) { Math.Round(List.Flatten(i)/1000000000, 2); }
code_block_358 = CodeBlock { "M3"; }
count_70 = List.Count(list=code_block_357)
ofRepeatedItem_57 = List.OfRepeatedItem(item=code_block_358, amount=count_70)
code_block_359 = CodeBlock(FuncValues=code_block_357, FuncValuesUnit=ofRepeatedItem_57)  # same code as code_block_18

# group: Output Manager
output_42 = CodeBlock(MainOutput=code_block_359) { MainOutput; RefOutput_geoColor; }  # unwired: RefOutput_geoColor
reference_output_42 = CodeBlock { ref; }  # unwired: ref

# group: Input Manager
value_for_import_from_others_50 = CodeBlock(MainInput=code_block_308) { MainInput; RefInput1; RefInput2; }  # unwired: RefInput1, RefInput2

# group: <Func 10>Rebar Work
code_block_360 = CodeBlock { "TargetElements"; }
valueAtKey_75 = DesignScript.Builtin.Dictionary.ValueAtKey(dictionary=value_for_import_from_others_50.MainInput, key=code_block_360)
code_block_361 = CodeBlock { "Volume"; }
# note: <Func>
getParameterValueByName_15 = Element.GetParameterValueByName(element=valueAtKey_75, parameterName=code_block_361)
sog_철근비_3 = DoubleInput(0)  # graph input
mul_6 = getParameterValueByName_15 * sog_철근비_3
code_block_362 = CodeBlock(i=mul_6) { Math.Round(List.Flatten(i)/1, 2); }
code_block_363 = CodeBlock { "TON"; }
count_71 = List.Count(list=code_block_362)
ofRepeatedItem_58 = List.OfRepeatedItem(item=code_block_363, amount=count_71)
code_block_364 = CodeBlock(FuncValues=code_block_362, FuncValuesUnit=ofRepeatedItem_58)  # same code as code_block_18

# group: Output Manager
output_43 = CodeBlock(MainOutput=code_block_364) { MainOutput; RefOutput_geoColor; }  # unwired: RefOutput_geoColor
reference_output_43 = CodeBlock { ref; }  # unwired: ref

join_6 = List.Join(list0=output_35.MainOutput, list1=output_36.MainOutput, list2=output_37.MainOutput, list3=output_38.MainOutput, list4=output_34.MainOutput, list5=output_39.MainOutput, list6=output_40.MainOutput, list7=output_41.MainOutput, list8=output_42.MainOutput, list9=output_33.MainOutput, list10=output_43.MainOutput)

# group: TargetWMunique + Data Sending
code_block_365 = CodeBlock(InputDic2=join_6) { _InputDic2; }
count_72 = List.Count(list=code_block_365)
code_block_366 = CodeBlock { _InputDic1; }  # unwired: InputDic1
code_block_367 = CodeBlock { "TargetWMunique"; }
valueAtKey_76 = DesignScript.Builtin.Dictionary.ValueAtKey(dictionary=code_block_366, key=code_block_367)
watch_33 = Watch(valueAtKey_76)
count_73 = List.Count(list=watch_33)
eq_6 = count_72 == count_73
organizeFuncValuesAndWorkMasterAsDiction_6 = Custom[OrganizeFuncValuesAndWorkMasterAsDictionary](InputDic1=code_block_366, InputDic2=code_block_365)
watch_34 = Watch()  # unwired: arg0
if_15 = If(test=eq_6, true=organizeFuncValuesAndWorkMasterAsDiction_6, false=watch_34)

# group: <Func 6> Visual Manager
visual_켜기_끄기_14 = BoolSelector(false)
visual_manager_14 = Python(IN[0]=output_35.RefOutput_geoColor, IN[1]=visual_켜기_끄기_14)  # CPython3; same code as visual_manager

# group: WorkMaster 정리 후 재 작업
code_block_368 = CodeBlock {  }
code_block_369 = CodeBlock {  }

watch_35 = Watch(select_target_family_element_and)

# group: Select Target Family Element And Connected WorkMasters
code_block_370 = CodeBlock { 2; }
select_target_family_element_and_3 = Python(IN[0]=set_up_all_element_inform_as, IN[1]=code_block_370)  # "Select Target Family Element And Connected WorkMasters"; CPython3; same code as select_target_family_element_and

watch_36 = Watch(select_target_family_element_and_3)

# group: 사용된 패밀리 타입 종류 확인 구간
code_block_371 = CodeBlock { "ElementType"; }
valueAtKey_77 = DesignScript.Builtin.Dictionary.ValueAtKey(dictionary=set_up_all_element_inform_as, key=code_block_371)
uniqueItems_4 = List.UniqueItems(list=valueAtKey_77)
watch_37 = Watch(uniqueItems_4)
code_block_372 = CodeBlock { "FamilyCode"; }
valueAtKey_78 = DesignScript.Builtin.Dictionary.ValueAtKey(dictionary=set_up_all_element_inform_as, key=code_block_372)
uniqueItems_5 = List.UniqueItems(list=valueAtKey_78)
watch_38 = Watch(uniqueItems_5)

# group: Primary Input : Excel & Revit Elements
categories_3 = Categories("OST_StructuralFoundation")
all_elements_of_category_3 = ElementsOfCategory(Category=categories_3)
string_from_web_2 = Python()  # CPython3; unwired: IN[0]
# ---------- string_from_web_2.python (19 lines) ----------
# Load the Python Standard and DesignScript Libraries
import sys
import clr
clr.AddReference('ProtoGeometry')
from Autodesk.DesignScript.Geometry import *
import urllib.request

# The inputs to this node will be stored as a list in the IN variables.
dataEnteringNode = IN
inputURL = "https://raw.githubusercontent.com/HNANmal/mQ/master/Laboratory/20211123_%EC%9E%85%EC%B0%B0%EC%9E%90%EB%8F%99%ED%99%94%ED%88%B4Test%20Sample/test.py"

# Place your code below this line
req = urllib.request
data = req.urlopen(inputURL)

result = data.read().decode("utf-8")

# Assign your output to the OUT variable.
OUT = result
# ----------------------------------------
file_path_2 = Filename("..\1215\BIM_물량집계 자동화 산출기준표_rC(20211207)_강한호_qlqh.xlsx")  # graph input
sheet_name_2 = CodeBlock { "Str Foundations"; }
github_python_import_excel_by_2 = PythonStringNode(script=string_from_web_2, IN[0]=file_path_2, IN[1]=sheet_name_2)  # "Github_Python@Import Excel(By OpenpyXl)"; CPython3
code_block_373 = CodeBlock(InputElement=all_elements_of_category_3, InputData=github_python_import_excel_by_2) { _InputElement; _InputData; }

# group: GetFull WMCodeDescription PerElement
excelDataManagerNode_2 = Python(IN[0]=code_block_373._InputElement, IN[1]=code_block_373._InputData)  # CPython3; same code as excelDataManagerNode

# group: Organize AllElementInform AsDictionary
set_up_all_element_inform_as_2 = Python(IN[0]=excelDataManagerNode_2)  # "Set Up All Element Inform as Dictionary"; CPython3; same code as set_up_all_element_inform_as

# group: Select Target Family Element And Connected WorkMasters
code_block_374 = CodeBlock { 1; }
select_target_family_element_and_4 = Python(IN[0]=set_up_all_element_inform_as_2, IN[1]=code_block_374)  # "Select Target Family Element And Connected WorkMasters"; CPython3; same code as select_target_family_element_and

watch_39 = Watch(select_target_family_element_and_4)
code_block_375 = CodeBlock(i=watch_39) { i; }

# group: Input Manager
value_for_import_from_others_51 = CodeBlock(MainInput=code_block_375) { MainInput; RefInput1; RefInput2; }  # unwired: RefInput1, RefInput2

# group: <Func 9>Lean Concrete
code_block_376 = CodeBlock { "TargetElements"; }
valueAtKey_79 = DesignScript.Builtin.Dictionary.ValueAtKey(dictionary=value_for_import_from_others_51.MainInput, key=code_block_376)
code_block_377 = CodeBlock { 0; 100; }
# note: <Func>
createLeanConcrete_11 = Custom[CreateLeanConcrete](Element=valueAtKey_79, leanOffset=code_block_377.out0, leanThick=code_block_377.out1)
volume_23 = Solid.Volume(solid=createLeanConcrete_11.Solid)
code_block_378 = CodeBlock(i=volume_23) { Math.Round(List.Flatten(i)/1000000000, 2); }
code_block_379 = CodeBlock { "M3"; }
count_74 = List.Count(list=code_block_378)
ofRepeatedItem_59 = List.OfRepeatedItem(item=code_block_379, amount=count_74)
code_block_380 = CodeBlock(FuncValues=code_block_378, FuncValuesUnit=ofRepeatedItem_59)  # same code as code_block_18

# group: Output Manager
output_44 = CodeBlock(MainOutput=code_block_380, RefOutput_geoColor=createLeanConcrete_11.Solid) { MainOutput; RefOutput_geoColor; }
reference_output_44 = CodeBlock(ref=createLeanConcrete_11.Solid) { ref; }

join_7 = List.Join(list0=output_44.MainOutput)  # unwired: list1, list2, list3, list4, list5, list6, list7, list8, list9, list10

# group: TargetWMunique + Data Sending
code_block_381 = CodeBlock(InputDic2=join_7) { _InputDic2; }
count_75 = List.Count(list=code_block_381)
code_block_382 = CodeBlock(InputDic1=code_block_375) { _InputDic1; }
code_block_383 = CodeBlock { "TargetWMunique"; }
valueAtKey_80 = DesignScript.Builtin.Dictionary.ValueAtKey(dictionary=code_block_382, key=code_block_383)
watch_40 = Watch(valueAtKey_80)
count_76 = List.Count(list=watch_40)
eq_7 = count_75 == count_76
organizeFuncValuesAndWorkMasterAsDiction_7 = Custom[OrganizeFuncValuesAndWorkMasterAsDictionary](InputDic1=code_block_382, InputDic2=code_block_381)
watch_41 = Watch()  # unwired: arg0
if_16 = If(test=eq_7, true=organizeFuncValuesAndWorkMasterAsDiction_7, false=watch_41)

# group: Visual Manager
visual_켜기_끄기_15 = BoolSelector(false)
visual_manager_15 = Python(IN[0]=output_44.RefOutput_geoColor, IN[1]=visual_켜기_끄기_15)  # CPython3; same code as visual_manager

# group: Sample
code_block_384 = CodeBlock {  }
code_block_385 = CodeBlock {  }

# group: Sample
code_block_386 = CodeBlock {  }
code_block_387 = CodeBlock {  }

code_block_388 = CodeBlock(i=code_block_237) { i; }

# group: Input Manager
value_for_import_from_others_52 = CodeBlock(MainInput=code_block_388) { MainInput; RefInput1; RefInput2; }  # unwired: RefInput1, RefInput2

# group: <Func 9>Lean Concrete
code_block_389 = CodeBlock { "TargetElements"; }
valueAtKey_81 = DesignScript.Builtin.Dictionary.ValueAtKey(dictionary=value_for_import_from_others_52.MainInput, key=code_block_389)
code_block_390 = CodeBlock { 0; 100; }
# note: <Func>
createLeanConcrete_12 = Custom[CreateLeanConcrete](Element=valueAtKey_81, leanOffset=code_block_390.out0, leanThick=code_block_390.out1)
volume_24 = Solid.Volume(solid=createLeanConcrete_12.Solid)
code_block_391 = CodeBlock(i=volume_24) { Math.Round(List.Flatten(i)/1000000000, 2); }
code_block_392 = CodeBlock { "M3"; }
count_77 = List.Count(list=code_block_391)
ofRepeatedItem_60 = List.OfRepeatedItem(item=code_block_392, amount=count_77)
code_block_393 = CodeBlock(FuncValues=code_block_391, FuncValuesUnit=ofRepeatedItem_60)  # same code as code_block_18

# group: Output Manager
reference_output_45 = CodeBlock(ref=createLeanConcrete_12.Solid) { ref; }
output_45 = CodeBlock(MainOutput=code_block_393, RefOutput_geoColor=createLeanConcrete_12.Solid) { MainOutput; RefOutput_geoColor; }

# group: Input Manager
value_for_import_from_others_53 = CodeBlock(MainInput=code_block_388, RefInput1=reference_output_45) { MainInput; RefInput1; RefInput2; }  # unwired: RefInput2

# group: <Func 4> Excavation (SOG 한정)
levels_6 = Levels("G.L")  # graph input
elevation_6 = Level.Elevation(level=levels_6)
code_block_394 = CodeBlock { "TargetElements"; }
valueAtKey_82 = DesignScript.Builtin.Dictionary.ValueAtKey(dictionary=value_for_import_from_others_53.MainInput, key=code_block_394)
code_block_395 = CodeBlock { "Elevation at Bottom"; }
getParameterValueByName_16 = Element.GetParameterValueByName(element=valueAtKey_82, parameterName=code_block_395)
린_콘크리트_하부까지의_길이_추출_최하단_6 = Python(IN[0]=value_for_import_from_others_53.RefInput1)  # CPython3; same code as 린_콘크리트_하부까지의_길이_추출_최하단
code_block_396 = CodeBlock(기초하단=getParameterValueByName_16, 린콘크리트하단=린_콘크리트_하부까지의_길이_추출_최하단_6) { 기초하단-린콘크리트하단; }
sub_6 = elevation_6 - code_block_396
code_block_397 = CodeBlock(i=sub_6) { i<0?true:false; }
code_block_398 = CodeBlock { 0; }
flatten_66 = List.Flatten(list=value_for_import_from_others_53.RefInput1)
하부_surface_추출_7 = Python(IN[0]=flatten_66)  # CPython3; same code as 하부_surface_추출
flatten_67 = List.Flatten(list=하부_surface_추출_7)
perimeterCurves_6 = Surface.PerimeterCurves(surface=flatten_67)
byJoinedCurves_6 = PolyCurve.ByJoinedCurves(curves=perimeterCurves_6)
code_block_399 = CodeBlock { _ExcavOffsetBottom: var[]..[] = 300; }
offset_11 = Curve.Offset(curve=byJoinedCurves_6, distance=code_block_399)
flatten_68 = List.Flatten(list=offset_11)
flatten_69 = List.Flatten(list=sub_6)
translate_6 = Geometry.Translate(geometry=offset_11, zTranslation=flatten_69)
경사_비율_입력_1_x_for_isofdn_5 = DoubleInput(2)  # graph input
code_block_400 = CodeBlock(ElevationatBottom=flatten_69, 비율=경사_비율_입력_1_x_for_isofdn_5) { ElevationatBottom/비율; }
offset_12 = Curve.Offset(curve=translate_6, distance=code_block_400)
flatten_70 = List.Flatten(list=offset_12)
list_create_10 = List.Create(item0=flatten_68, item1=flatten_70)
transpose_10 = List.Transpose(lists=list_create_10)
byLoft_6 = Solid.ByLoft(crossSections=transpose_10)
터파기_형상_겹침_해소_6 = Python(IN[0]=byLoft_6)  # CPython3; same code as 터파기_형상_겹침_해소
volume_25 = Solid.Volume(solid=터파기_형상_겹침_해소_6)
code_block_401 = CodeBlock(i=volume_25) { Math.Round(List.Flatten(i)/1000000000, 2); }
if_17 = If(test=code_block_397, true=code_block_398, false=code_block_401)
code_block_402 = CodeBlock { "M3"; }
count_78 = List.Count(list=code_block_401)
ofRepeatedItem_61 = List.OfRepeatedItem(item=code_block_402, amount=count_78)
code_block_403 = CodeBlock(FuncValues=if_17, FuncValuesUnit=ofRepeatedItem_61)  # same code as code_block_18
color_palette_10 = ColorPalette({R: 210, G: 105, B: 30, A: 135})
byGeometryColor_10 = Modifiers.GeometryColor.ByGeometryColor(geometry=터파기_형상_겹침_해소_6, color=color_palette_10)
forRefOutput_6 = CodeBlock(MainOutput=code_block_403, geoColor=byGeometryColor_10, 터파기형상=터파기_형상_겹침_해소_6)  # same code as forRefOutput

# group: Output Manager
output_46 = CodeBlock(MainOutput=forRefOutput_6, RefOutput_geoColor=byGeometryColor_10) { MainOutput; RefOutput_geoColor; }
reference_output_46 = CodeBlock(ref=터파기_형상_겹침_해소_6, ref2=if_17) { ref; ref2; }

# group: Visual Manager
visual_켜기_끄기_16 = BoolSelector(false)
visual_manager_16 = Python(IN[0]=output_46.RefOutput_geoColor, IN[1]=visual_켜기_끄기_16)  # CPython3; same code as visual_manager

# group: Visual Manager
visual_켜기_끄기_17 = BoolSelector(false)
visual_manager_17 = Python(IN[0]=output_45.RefOutput_geoColor, IN[1]=visual_켜기_끄기_17)  # CPython3; same code as visual_manager

# group: Input Manager
value_for_import_from_others_54 = CodeBlock(MainInput=code_block_388) { MainInput; RefInput1; RefInput2; }  # unwired: RefInput1, RefInput2

# group: <Func 0> Hardner Finish (상부면)
code_block_404 = CodeBlock { "TargetElements"; }
# note: <Func>
valueAtKey_83 = DesignScript.Builtin.Dictionary.ValueAtKey(dictionary=value_for_import_from_others_54.MainInput, key=code_block_404)
flatten_71 = List.Flatten(list=valueAtKey_83)
# note: 일반화 여지가 있음
# (형상처리구간 + 물량계산 + 데이터 매칭)
extractUpperFacesOfElement_6 = Custom[ExtractUpperFacesOfElement](Element=flatten_71)
area_18 = Surface.Area(surface=extractUpperFacesOfElement_6.Surface)
sum_8 = Math.Sum(values=area_18)
code_block_405 = CodeBlock(i=sum_8) { Math.Round(List.Flatten(i)/1000000, 2); }
code_block_406 = CodeBlock { "M2"; }
count_79 = List.Count(list=code_block_405)
ofRepeatedItem_62 = List.OfRepeatedItem(item=code_block_406, amount=count_79)
code_block_407 = CodeBlock(FuncValues=code_block_405, FuncValuesUnit=ofRepeatedItem_62)  # same code as code_block_18
color_palette_11 = ColorPalette({R: 30, G: 144, B: 255, A: 129})
byGeometryColor_11 = Modifiers.GeometryColor.ByGeometryColor(geometry=extractUpperFacesOfElement_6.Surface, color=color_palette_11)

# group: Output Manager
output_47 = CodeBlock(MainOutput=code_block_407, RefOutput_geoColor=byGeometryColor_11) { MainOutput; RefOutput_geoColor; }
reference_output_47 = CodeBlock { ref; }  # unwired: ref

# group: Input Manager
value_for_import_from_others_55 = CodeBlock(MainInput=code_block_388) { MainInput; RefInput1; RefInput2; }  # unwired: RefInput1, RefInput2

# group: <Func 1> Structural Concrete
code_block_408 = CodeBlock { "TargetElements"; }
valueAtKey_84 = DesignScript.Builtin.Dictionary.ValueAtKey(dictionary=value_for_import_from_others_55.MainInput, key=code_block_408)
# note: <Func>
geometry_6 = Element.Geometry(element=valueAtKey_84)
volume_26 = Solid.Volume(solid=geometry_6)
code_block_409 = CodeBlock(i=volume_26) { Math.Round(List.Flatten(i)/1000000000,2); }
code_block_410 = CodeBlock { "M3"; }
count_80 = List.Count(list=code_block_409)
ofRepeatedItem_63 = List.OfRepeatedItem(item=code_block_410, amount=count_80)
code_block_411 = CodeBlock(FuncValues=code_block_409, FuncValuesUnit=ofRepeatedItem_63)  # same code as code_block_18

# group: Output Manager
output_48 = CodeBlock(MainOutput=code_block_411) { MainOutput; RefOutput_geoColor; }  # unwired: RefOutput_geoColor
reference_output_48 = CodeBlock(ref=geometry_6) { ref; }

# group: Input Manager
value_for_import_from_others_56 = CodeBlock(MainInput=code_block_388) { MainInput; RefInput1; RefInput2; }  # unwired: RefInput1, RefInput2

# group: <Func 2> Form Works (Ground Slab 거푸집 필요X)
code_block_412 = CodeBlock { "TargetElements"; }
valueAtKey_85 = DesignScript.Builtin.Dictionary.ValueAtKey(dictionary=value_for_import_from_others_56.MainInput, key=code_block_412)
code_block_413 = CodeBlock { "Volume"; }
# note: <Func>
getParameterValueByName_17 = Element.GetParameterValueByName(element=valueAtKey_85, parameterName=code_block_413)
code_block_414 = CodeBlock(i=getParameterValueByName_17) { Math.Round(List.Flatten(i)/10000000,2); }
code_block_415 = CodeBlock { "M3"; }
count_81 = List.Count(list=code_block_414)
ofRepeatedItem_64 = List.OfRepeatedItem(item=code_block_415, amount=count_81)
code_block_416 = CodeBlock(FuncValues=code_block_414, FuncValuesUnit=ofRepeatedItem_64)  # same code as code_block_18

# group: Output Manager
output_49 = CodeBlock(MainOutput=code_block_416) { MainOutput; RefOutput_geoColor; }  # unwired: RefOutput_geoColor
reference_output_49 = CodeBlock { ref; }  # unwired: ref

# group: Input Manager
value_for_import_from_others_57 = CodeBlock(MainInput=code_block_388) { MainInput; RefInput1; RefInput2; }  # unwired: RefInput1, RefInput2

# group: <Func 3> PE Sheet
code_block_417 = CodeBlock { "TargetElements"; }
valueAtKey_86 = DesignScript.Builtin.Dictionary.ValueAtKey(dictionary=value_for_import_from_others_57.MainInput, key=code_block_417)
# note: <Func>
createLeanConcrete_13 = Custom[CreateLeanConcrete](Element=valueAtKey_86)
area_19 = Surface.Area(surface=createLeanConcrete_13.Surface)
code_block_418 = CodeBlock(i=area_19) { Math.Round(List.Flatten(i)/1000000, 2); }
code_block_419 = CodeBlock { "M2"; }
count_82 = List.Count(list=code_block_418)
ofRepeatedItem_65 = List.OfRepeatedItem(item=code_block_419, amount=count_82)
code_block_420 = CodeBlock(FuncValues=code_block_418, FuncValuesUnit=ofRepeatedItem_65)  # same code as code_block_18

# group: Output Manager
output_50 = CodeBlock(MainOutput=code_block_420) { MainOutput; RefOutput_geoColor; }  # unwired: RefOutput_geoColor
reference_output_50 = CodeBlock { ref; }  # unwired: ref

# group: Input Manager
value_for_import_from_others_58 = CodeBlock(MainInput=code_block_388, RefInput1=reference_output_45, RefInput2=reference_output_46.ref, RefInput3=reference_output_48) { MainInput; RefInput1; RefInput2; RefInput3; }

# group: <Func 2> Backfill
value_for_import_from_others_59 = CodeBlock(터파기형상=value_for_import_from_others_58.RefInput2) { 터파기형상; }
flatten_72 = List.Flatten(list=value_for_import_from_others_59)
volume_27 = Solid.Volume(solid=flatten_72)
watch_42 = Watch(volume_27)
code_block_421 = CodeBlock(i=watch_42) { Math.Round(List.Flatten(i)/1000000000, 2); }
code_block_422 = CodeBlock { "M3"; }
count_83 = List.Count(list=watch_42)
ofRepeatedItem_66 = List.OfRepeatedItem(item=code_block_422, amount=count_83)
# note: 터파기 물량ㅈ에서 콘크리트, 린 기둥 물량 빼기
code_block_423 = CodeBlock(FuncValues=code_block_421, FuncValuesUnit=ofRepeatedItem_66)  # same code as code_block_18
value_for_import_from_others_60 = CodeBlock(슬라브형상=value_for_import_from_others_58.RefInput3) { 슬라브형상; }
flatten_73 = List.Flatten(list=value_for_import_from_others_60)
doesIntersect_6 = Geometry.DoesIntersect(geometry=flatten_72, other=flatten_73, lacing=CrossProduct)
filterByBoolMask_5 = List.FilterByBoolMask(list=flatten_73, mask=doesIntersect_6@L2)
flatten_74 = List.Flatten(list=filterByBoolMask_5.in)

# group: Output Manager
output_51 = CodeBlock(MainOutput=code_block_423) { MainOutput; RefOutput_geoColor; }  # unwired: RefOutput_geoColor
reference_output_51 = CodeBlock { ref; }  # unwired: ref

# group: Input Manager
value_for_import_from_others_61 = CodeBlock(MainInput=code_block_388, RefInput1=reference_output_46.ref2) { MainInput; RefInput1; RefInput2; }  # unwired: RefInput2

# group: <Func 6>Disposal
code_block_424 = CodeBlock(i=value_for_import_from_others_61.RefInput1) { i==0?true:false; }
code_block_425 = CodeBlock { 0; }
# note: <Func>
if_18 = If(test=code_block_424, true=code_block_425, false=value_for_import_from_others_61.RefInput1)
code_block_426 = CodeBlock(i=if_18) { Math.Round(List.Flatten(i)/1000000000, 2); }
code_block_427 = CodeBlock { "M3"; }
count_84 = List.Count(list=code_block_426)
ofRepeatedItem_67 = List.OfRepeatedItem(item=code_block_427, amount=count_84)
code_block_428 = CodeBlock(FuncValues=code_block_426, FuncValuesUnit=ofRepeatedItem_67)  # same code as code_block_18
code_block_429 = CodeBlock { "TargetElements"; }
valueAtKey_87 = DesignScript.Builtin.Dictionary.ValueAtKey(dictionary=value_for_import_from_others_61.MainInput, key=code_block_429)
count_85 = List.Count(list=valueAtKey_87@L1)

# group: Output Manager
output_52 = CodeBlock(MainOutput=code_block_428) { MainOutput; RefOutput_geoColor; }  # unwired: RefOutput_geoColor
reference_output_52 = CodeBlock { ref; }  # unwired: ref

# group: Input Manager
value_for_import_from_others_62 = CodeBlock(MainInput=code_block_388) { MainInput; RefInput1; RefInput2; }  # unwired: RefInput1, RefInput2

# group: <Func 7>Base Course
code_block_430 = CodeBlock { "TargetElements"; }
valueAtKey_88 = DesignScript.Builtin.Dictionary.ValueAtKey(dictionary=value_for_import_from_others_62.MainInput, key=code_block_430)
code_block_431 = CodeBlock { 300; 100; }
# note: <Func>
createBaseCourseSurfaces_9 = Custom[CreateBaseCourseSurfaces](Element=valueAtKey_88, BaseCourseOffsetBottom=code_block_431.out0, leanThick=code_block_431.out1)
area_20 = Surface.Area(surface=createBaseCourseSurfaces_9.Surface)
code_block_432 = CodeBlock(i=area_20) { Math.Round(List.Flatten(i)/1000000, 2); }
code_block_433 = CodeBlock { "M2"; }
count_86 = List.Count(list=code_block_432)
ofRepeatedItem_68 = List.OfRepeatedItem(item=code_block_433, amount=count_86)
code_block_434 = CodeBlock(FuncValues=code_block_432, FuncValuesUnit=ofRepeatedItem_68)  # same code as code_block_18

# group: Output Manager
output_53 = CodeBlock(MainOutput=code_block_434) { MainOutput; RefOutput_geoColor; }  # unwired: RefOutput_geoColor
reference_output_53 = CodeBlock(ref=createBaseCourseSurfaces_9.Surface) { ref; }

# group: Input Manager
value_for_import_from_others_63 = CodeBlock(MainInput=code_block_388, RefInput1=reference_output_53) { MainInput; RefInput1; RefInput2; }  # unwired: RefInput2

# group: <Func 8>Crushed Stone
code_block_435 = CodeBlock { "TargetElements"; }
valueAtKey_89 = DesignScript.Builtin.Dictionary.ValueAtKey(dictionary=value_for_import_from_others_63.MainInput, key=code_block_435)
# note: <Func>
code_block_436 = CodeBlock { 300; 100; }
createBaseCourseSurfaces_10 = Custom[CreateBaseCourseSurfaces](Element=valueAtKey_89, BaseCourseOffsetBottom=code_block_436.out0, leanThick=code_block_436.out1)
boolean_5 = BoolSelector(false)
thicken_4 = Surface.Thicken(surface=createBaseCourseSurfaces_10.Surface, thickness=code_block_436.out0, both_sides=boolean_5)
volume_28 = Solid.Volume(solid=thicken_4)
code_block_437 = CodeBlock(i=volume_28) { Math.Round(List.Flatten(i)/1000000000, 2); }
code_block_438 = CodeBlock { "M3"; }
count_87 = List.Count(list=code_block_437)
ofRepeatedItem_69 = List.OfRepeatedItem(item=code_block_438, amount=count_87)
code_block_439 = CodeBlock(FuncValues=code_block_437, FuncValuesUnit=ofRepeatedItem_69)  # same code as code_block_18

# group: Output Manager
output_54 = CodeBlock(MainOutput=code_block_439) { MainOutput; RefOutput_geoColor; }  # unwired: RefOutput_geoColor
reference_output_54 = CodeBlock { ref; }  # unwired: ref

# group: Input Manager
value_for_import_from_others_64 = CodeBlock(MainInput=code_block_388) { MainInput; RefInput1; RefInput2; }  # unwired: RefInput1, RefInput2

# group: <Func 10>Rebar Work
code_block_440 = CodeBlock { "TargetElements"; }
valueAtKey_90 = DesignScript.Builtin.Dictionary.ValueAtKey(dictionary=value_for_import_from_others_64.MainInput, key=code_block_440)
code_block_441 = CodeBlock { "Volume"; }
# note: <Func>
getParameterValueByName_18 = Element.GetParameterValueByName(element=valueAtKey_90, parameterName=code_block_441)
sog_철근비_4 = DoubleInput(0)  # graph input
mul_7 = getParameterValueByName_18 * sog_철근비_4
code_block_442 = CodeBlock(i=mul_7) { Math.Round(List.Flatten(i)/1, 2); }
code_block_443 = CodeBlock { "TON"; }
count_88 = List.Count(list=code_block_442)
ofRepeatedItem_70 = List.OfRepeatedItem(item=code_block_443, amount=count_88)
code_block_444 = CodeBlock(FuncValues=code_block_442, FuncValuesUnit=ofRepeatedItem_70)  # same code as code_block_18

# group: Output Manager
output_55 = CodeBlock(MainOutput=code_block_444) { MainOutput; RefOutput_geoColor; }  # unwired: RefOutput_geoColor
reference_output_55 = CodeBlock { ref; }  # unwired: ref

join_8 = List.Join(list0=output_47.MainOutput, list1=output_48.MainOutput, list2=output_49.MainOutput, list3=output_50.MainOutput, list4=output_46.MainOutput, list5=output_51.MainOutput, list6=output_52.MainOutput, list7=output_53.MainOutput, list8=output_54.MainOutput, list9=output_45.MainOutput, list10=output_55.MainOutput)

# group: TargetWMunique + Data Sending
code_block_445 = CodeBlock(InputDic2=join_8) { _InputDic2; }
count_89 = List.Count(list=code_block_445)
code_block_446 = CodeBlock(InputDic1=code_block_237) { _InputDic1; }
code_block_447 = CodeBlock { "TargetWMunique"; }
valueAtKey_91 = DesignScript.Builtin.Dictionary.ValueAtKey(dictionary=code_block_446, key=code_block_447)
watch_43 = Watch(valueAtKey_91)
count_90 = List.Count(list=watch_43)
eq_8 = count_89 == count_90
organizeFuncValuesAndWorkMasterAsDiction_8 = Custom[OrganizeFuncValuesAndWorkMasterAsDictionary](InputDic1=code_block_446, InputDic2=code_block_445)
watch_44 = Watch()  # unwired: arg0
if_19 = If(test=eq_8, true=organizeFuncValuesAndWorkMasterAsDiction_8, false=watch_44)

watch_45 = Watch(output_46.MainOutput)

# group: <Func 6> Visual Manager
visual_켜기_끄기_18 = BoolSelector(false)
visual_manager_18 = Python(IN[0]=output_47.RefOutput_geoColor, IN[1]=visual_켜기_끄기_18)  # CPython3; same code as visual_manager

code_block_448 = CodeBlock {  }
code_block_449 = CodeBlock {  }
code_block_450 = CodeBlock { 2; }
select_target_family_element_and_5 = Python(IN[0]=set_up_all_element_inform_as, IN[1]=code_block_450)  # "Select Target Family Element And Connected WorkMasters"; CPython3; same code as select_target_family_element_and
