# Dynamo graph 05 Str Framing (1220).dyn (Dynamo 2.12.0.5650)

# group: Str Framing
code_block = CodeBlock {  }
code_block_2 = CodeBlock {  }

# group: Primary Input : Excel & Revit Elements
categories = Categories("OST_StructuralFraming")
all_elements_of_category = ElementsOfCategory(Category=categories)
string_from_web = Python()  # CPython3; unwired: IN[0]
# ---------- string_from_web.python (19 lines) ----------
# Load the Python Standard and DesignScript Libraries
import sys
import clr
clr.AddReference('ProtoGeometry')
from Autodesk.DesignScript.Geometry import *
import urllib.request

# The inputs to this node will be stored as a list in the IN variables.
dataEnteringNode = IN
inputURL = "https://raw.githubusercontent.com/HNANmal/mQ/master/Hdynlib/General/ImportExcel.py"

# Place your code below this line
req = urllib.request
data = req.urlopen(inputURL)

result = data.read().decode("utf-8")

# Assign your output to the OUT variable.
OUT = result
# ----------------------------------------
file_path = Filename(".\BIM_물량집계 자동화 산출기준표_rC(20211207)_강한호 (1).xlsx")  # graph input
sheet_name = CodeBlock { "Str Framing"; }
github_python_import_excel_by = PythonStringNode(script=string_from_web, IN[0]=file_path, IN[1]=sheet_name)  # "Github_Python@Import Excel(By OpenpyXl)"; CPython3
code_block_3 = CodeBlock(InputElement=all_elements_of_category, InputData=github_python_import_excel_by) { _InputElement; _InputData; }

# group: GetFull WMCodeDescription PerElement
excelDataManagerNode = Python(IN[0]=code_block_3._InputElement, IN[1]=code_block_3._InputData)  # CPython3
# ---------- excelDataManagerNode.python (279 lines) ----------
# Load the Python Standard and DesignScript Libraries
import os
import sys
sys.path.append(os.getenv('LOCALAPPDATA').replace('\\','\\\\') + r'\Programs\Python\Python39\Lib\site-packages')
import clr
clr.AddReference('RevitAPI')
import Autodesk

clr.AddReference('ProtoGeometry')
from Autodesk.DesignScript.Geometry import *

clr.AddReference('RevitNodes')
import Revit
clr.ImportExtensions(Revit.Elements)

clr.ImportExtensions(Revit.GeometryConversion)
clr.ImportExtensions(Revit.GeometryReferences)

clr.AddReference('RevitServices')
import RevitServices
from RevitServices.Persistence import DocumentManager
from RevitServices.Transactions import TransactionManager

doc = DocumentManager.Instance.CurrentDBDocument

import random
import itertools
from functools import reduce
from collections import Iterable
import datetime
import openpyxl

def iterable(obj):
    return isinstance(obj, Iterable)

def findUnique(inputs):
    result = []
    for i in inputs:
        if i in result:
            pass
        else:
            result.append(i)
    return result

# The inputs to this node will be stored as a list in the IN variables.
dataEnteringNode = IN
inputElements = IN[0]
inputData = IN[1]
#inputSheetName = IN[2]

def importExcel(path, SheetNameIn):
    wb_obj = openpyxl.load_workbook(str(path), data_only=True)
    sheet_obj = wb_obj.get_sheet_by_name(str(SheetNameIn))

    m_row = sheet_obj.max_row
    m_col = sheet_obj.max_column

    listOut = []

    for i in range(1, m_row +1):
        listTemp = []
        for j in range(1, m_col + 1):
            cell_obj = sheet_obj.cell(row=i, column=j)
            listTemp.append(cell_obj.value)
            if len(listTemp) == m_col:
                listOut.append(listTemp)
    return listOut

def getUsedFamilyTypeOfModeling(elements):
    familyCode = list(map(lambda x: x.Name.split('_')[0], elements))
    unq_familyCode = findUnique(familyCode)
    return unq_familyCode
    
def createExcelDataDictionary(values):
    result = {}
    for i in range(len(values)):
        result[str(i)] = values[i]
    return result

def findTargetIndex(targets, list):
    result = []
    for target in targets:
        for i in range(len(list)):
            if target in str(list[i]):
                result.append(i)
            else:
                pass
    result.sort()
    return result
    
def GetValueAtKeys(keys, dictionary):
    result = [] 
    for i in keys:
        result.append(dictionary[str(i)])
    return result


# Place your code below this line
usedFamilyTypeOfModeling = getUsedFamilyTypeOfModeling(inputElements)
excelWholeDataSet = inputData#importExcel(inputFilePath, inputSheetName)
trExcelWholeDataSet = list(zip(*excelWholeDataSet))
excelColumnDataSet = createExcelDataDictionary(trExcelWholeDataSet)
excelRowDataSet = createExcelDataDictionary(excelWholeDataSet)
ColumnIndexOfUsedFamilyType = findTargetIndex(usedFamilyTypeOfModeling, trExcelWholeDataSet)
ColDataSetOfUsedFamilyType = GetValueAtKeys(ColumnIndexOfUsedFamilyType, excelColumnDataSet)
materialPerElementFromModeling = []
for i in inputElements:
    materialPerElementFromModeling.append(i.GetMaterials())
#list(map(lambda x: x.GetMaterials, inputElements)) "맵함수로 처리하면 리스트화 할 때 타입 변환 오류 남"

targetWMRowIndex = []
for i in ColDataSetOfUsedFamilyType:
    targetWMRowIndex.append(findTargetIndex(['000'], i))

rowDataSetOfUsedWM = []
for i in targetWMRowIndex:
    rowDataSetOfUsedWM.append(GetValueAtKeys(i, excelRowDataSet))

workGroup = []
for i in rowDataSetOfUsedWM:
    tmp = []
    for j in i:
        tmp.append(j[0])
    workGroup.append(tmp)
    
workMaster = []
for i in range(len(ColDataSetOfUsedFamilyType)):
    tmp=[]
    for k in targetWMRowIndex[i]:
        tmp.append(ColDataSetOfUsedFamilyType[i][k])
    workMaster.append(tmp)

matchedWM = []
for i in range(len(workGroup)):
    tmp = []
    for j in range(len(workGroup[i])):
        fullWM = workGroup[i][j] +"-"+ workMaster[i][j]
        tmp.append(fullWM)
    matchedWM.append(tmp)

matchedWorkGruopAndMasterCode = []
for i in matchedWM:
    if len(i) > 0:
        matchedWorkGruopAndMasterCode.append(i)
    else:
        pass

matchedWMDescription = []
for i in rowDataSetOfUsedWM:
    tmp=[]
    for j in i:
        tmp.append(j[1] +" "+ j[2] +" "+ j[3] +" "+ "("+ j[4] +")")
    if len(tmp) > 0:
        matchedWMDescription.append(tmp)
    else:
        pass

matchedWMUnit = []
for i in rowDataSetOfUsedWM:
    tmp=[]
    for j in i:
        tmp.append(j[4])
    if len(tmp) > 0:
        matchedWMUnit.append(tmp)
    else:
        pass

matchedWorkGruopAndMasterCode_flat = list(itertools.chain(*matchedWorkGruopAndMasterCode))
matchedWMDescription_flat = list(itertools.chain(*matchedWMDescription))

dic_WMandDescription_Excel = {}
for i in range(len(matchedWorkGruopAndMasterCode_flat)):
    dic_WMandDescription_Excel[matchedWorkGruopAndMasterCode_flat[i]] = matchedWMDescription_flat[i]

usedFamilyTypeInExcelOrder = list(map(lambda x: x[3], ColDataSetOfUsedFamilyType))
usedFamilyCodeInExcelOrder = findUnique(list(map(lambda x: x.split('_')[0], usedFamilyTypeInExcelOrder)))

dic_FamilyCodeandWM = {}
for i in range(len(usedFamilyCodeInExcelOrder)):
    dic_FamilyCodeandWM[usedFamilyCodeInExcelOrder[i]] = matchedWorkGruopAndMasterCode[i]

workMasterCodePerElement = []
familyCodePerElem = list(map(lambda x: x.Name.split('_')[0], inputElements))
for i in familyCodePerElem:
    workMasterCodePerElement.append(dic_FamilyCodeandWM[i])

materialNamePerElem = []
for i in materialPerElementFromModeling:
    tmp = []
    for j in i:
        tmp.append(j.Name)
    materialNamePerElem.append(tmp)

WMPerElementFromModeling = []
for i in materialNamePerElem:
    tmp = []
    for j in i:
        tmp.append(j.split('_')[0])
    WMPerElementFromModeling.append(tmp)

specPerElementFromModeling = []
for i in materialNamePerElem:
    tmp = []
    for j in i:
        a = j.split('_')
        del a[0]
        b = " ".join(a)
        tmp.append(b)
    specPerElementFromModeling.append(tmp)

WMPerElementFromModeling_flat = list(itertools.chain(*WMPerElementFromModeling))
specPerElementFromModeling_flat = list(itertools.chain(*specPerElementFromModeling))

dic_WMandDescription_Model = {}
for i in range(len(WMPerElementFromModeling_flat)):
    dic_WMandDescription_Model[WMPerElementFromModeling_flat[i]] = specPerElementFromModeling_flat[i]

def findAllKeys(dict):
    result = []
    for key in dict.keys():
        result.append(key)
    return result

def findAllValues(dict):
    result = []
    for key in dict.keys():
        result.append(dict[key])
    return result

keys_WMandDescription_Model = findAllKeys(dic_WMandDescription_Model)
keys_WMandDescription_Excel = findAllKeys(dic_WMandDescription_Excel)

keys_WMandDescription_Both = list(set(keys_WMandDescription_Model + keys_WMandDescription_Excel))
values_WMandDescription_Both = []
for i in keys_WMandDescription_Both:
    if i in keys_WMandDescription_Model:
        values_WMandDescription_Both.append(dic_WMandDescription_Model[i])
    else:
        values_WMandDescription_Both.append(dic_WMandDescription_Excel[i])

dic_WMandDescription_Both = {}
for i in range(len(keys_WMandDescription_Both)):
    dic_WMandDescription_Both[keys_WMandDescription_Both[i]] = values_WMandDescription_Both[i]

workMasterCodePerElementFromBoth = []
for i in range(len(workMasterCodePerElement)):
    #tmp = []
    a = WMPerElementFromModeling[i] + workMasterCodePerElement[i]
    b = findUnique(a)
    workMasterCodePerElementFromBoth.append(b)

specPerElement = []
for i in workMasterCodePerElementFromBoth:
    tmp = []
    for j in i:
        tmp.append(dic_WMandDescription_Both[j])
    specPerElement.append(tmp)

fullWMCodeDescriptionPerElement = []
for i in range(len(workMasterCodePerElementFromBoth)):
    tmp = []
    for j in range(len(workMasterCodePerElementFromBoth[i])):
        a = workMasterCodePerElementFromBoth[i][j] +": "+ specPerElement[i][j]
        tmp.append(a)
    fullWMCodeDescriptionPerElement.append(tmp)

fullWMinfo = {
"AllElement": inputElements,
"WorkMasterCodePerFamilyType": dic_FamilyCodeandWM,
"WorkMasterCodePerElementBoth": workMasterCodePerElementFromBoth,
"FullWMCodeDescriptionPerElement": fullWMCodeDescriptionPerElement
}



result = fullWMinfo

# Assign your output to the OUT variable.
OUT = result
# ----------------------------------------

# group: Organize AllElementInform AsDictionary
set_up_all_element_inform_as = Python(IN[0]=excelDataManagerNode)  # "Set Up All Element Inform as Dictionary"; CPython3
# ---------- set_up_all_element_inform_as.python (119 lines) ----------
# Load the Python Standard and DesignScript Libraries
import os
import sys
sys.path.append(os.getenv('LOCALAPPDATA').replace('\\','\\\\') + r'\Programs\Python\Python39\Lib\site-packages')
import clr
clr.AddReference('RevitAPI')
import Autodesk

clr.AddReference('ProtoGeometry')
from Autodesk.DesignScript.Geometry import *

clr.AddReference('RevitNodes')
import Revit
clr.ImportExtensions(Revit.Elements)

clr.ImportExtensions(Revit.GeometryConversion)
clr.ImportExtensions(Revit.GeometryReferences)

clr.AddReference('RevitServices')
import RevitServices
from RevitServices.Persistence import DocumentManager
from RevitServices.Transactions import TransactionManager

doc = DocumentManager.Instance.CurrentDBDocument

import random
import itertools
from functools import reduce
from collections import Iterable
import datetime
import openpyxl

def iterable(obj):
    return isinstance(obj, Iterable)

def findUnique(inputs):
    result = []
    for i in inputs:
        if i in result:
            pass
        else:
            result.append(i)
    return result

# The inputs to this node will be stored as a list in the IN variables.
dataEnteringNode = IN
inputDict = IN[0]


def importExcel(path, SheetNameIn):
    wb_obj = openpyxl.load_workbook(str(path), data_only=True)
    sheet_obj = wb_obj.get_sheet_by_name(str(SheetNameIn))

    m_row = sheet_obj.max_row
    m_col = sheet_obj.max_column

    listOut = []

    for i in range(1, m_row +1):
        listTemp = []
        for j in range(1, m_col + 1):
            cell_obj = sheet_obj.cell(row=i, column=j)
            listTemp.append(cell_obj.value)
            if len(listTemp) == m_col:
                listOut.append(listTemp)
    return listOut

def getUsedFamilyTypeOfModeling(elements):
    familyCode = list(map(lambda x: x.Name.split('_')[0], elements))
    unq_familyCode = findUnique(familyCode)
    return unq_familyCode
    
def createExcelDataDictionary(values):
    result = {}
    for i in range(len(values)):
        result[str(i)] = values[i]
    return result

def findTargetIndex(targets, list):
    result = []
    for target in targets:
        for i in range(len(list)):
            if target in str(list[i]):
                result.append(i)
            else:
                pass
    result.sort()
    return result
    
def GetValueAtKeys(keys, dictionary):
    result = [] 
    for i in keys:
        result.append(dictionary[str(i)])
    return result


# Place your code below this line
element = inputDict["AllElement"]
elementType = []
for i in element:
    elementType.append(i.Name)
familyCode = []
for i in elementType:
    familyCode.append(i.split("_")[0])
fullWMCodeDescriptionPerElement = inputDict["FullWMCodeDescriptionPerElement"]

resultDict = {
"Element": element,
"ElementType": elementType,
"FamilyCode": familyCode,
"FullWMCodeDescriptionPerElement": fullWMCodeDescriptionPerElement
}



result = resultDict

# Assign your output to the OUT variable.
OUT = result
# ----------------------------------------

# group: Select Target Family Element And Connected WorkMasters
code_block_4 = CodeBlock { 0; }
select_target_family_element_and = Python(IN[0]=set_up_all_element_inform_as, IN[1]=code_block_4)  # "Select Target Family Element And Connected WorkMasters"; CPython3
# ---------- select_target_family_element_and.python (138 lines) ----------
# Load the Python Standard and DesignScript Libraries
import os
import sys
sys.path.append(os.getenv('LOCALAPPDATA').replace('\\','\\\\') + r'\Programs\Python\Python39\Lib\site-packages')
import clr
clr.AddReference('RevitAPI')
import Autodesk

clr.AddReference('ProtoGeometry')
from Autodesk.DesignScript.Geometry import *

clr.AddReference('RevitNodes')
import Revit
clr.ImportExtensions(Revit.Elements)

clr.ImportExtensions(Revit.GeometryConversion)
clr.ImportExtensions(Revit.GeometryReferences)

clr.AddReference('RevitServices')
import RevitServices
from RevitServices.Persistence import DocumentManager
from RevitServices.Transactions import TransactionManager

doc = DocumentManager.Instance.CurrentDBDocument

import random
import itertools
from functools import reduce
from collections import Iterable
import datetime
import openpyxl

def iterable(obj):
    return isinstance(obj, Iterable)

def findUnique(inputs):
    result = []
    for i in inputs:
        if i in result:
            pass
        else:
            result.append(i)
    return result

# The inputs to this node will be stored as a list in the IN variables.
dataEnteringNode = IN
inputDict = IN[0]
inputIndex = IN[1]


def importExcel(path, SheetNameIn):
    wb_obj = openpyxl.load_workbook(str(path), data_only=True)
    sheet_obj = wb_obj.get_sheet_by_name(str(SheetNameIn))

    m_row = sheet_obj.max_row
    m_col = sheet_obj.max_column

    listOut = []

    for i in range(1, m_row +1):
        listTemp = []
        for j in range(1, m_col + 1):
            cell_obj = sheet_obj.cell(row=i, column=j)
            listTemp.append(cell_obj.value)
            if len(listTemp) == m_col:
                listOut.append(listTemp)
    return listOut

def getUsedFamilyTypeOfModeling(elements):
    familyCode = list(map(lambda x: x.Name.split('_')[0], elements))
    unq_familyCode = findUnique(familyCode)
    return unq_familyCode
    
def createExcelDataDictionary(values):
    result = {}
    for i in range(len(values)):
        result[str(i)] = values[i]
    return result

def findTargetIndex(targets, list):
    result = []
    for target in targets:
        for i in range(len(list)):
            if target in str(list[i]):
                result.append(i)
            else:
                pass
    result.sort()
    return result
    
def GetValueAtKeys(keys, dictionary):
    result = [] 
    for i in keys:
        result.append(dictionary[str(i)])
    return result


# Place your code below this line
fullWMCodeDescriptionPerElement = inputDict["FullWMCodeDescriptionPerElement"]
element = inputDict["Element"]
familyCode = inputDict["FamilyCode"]
familyCode_unique = findUnique(familyCode)
targetFamilyCode = familyCode_unique[inputIndex]
targetIndex = []
for i in range(len(familyCode)):
    if targetFamilyCode in familyCode[i]:
        targetIndex.append(i)
    else:
        pass

targetElements = []
for i in targetIndex:
    targetElements.append(element[i])

targetFamilyCode = []
for i in targetIndex:
    targetFamilyCode.append(element[i].Name)

WMforTargetElements = []
for i in targetIndex:
    WMforTargetElements.append(fullWMCodeDescriptionPerElement[i])

WMforTargetElements_flat = list(itertools.chain(*WMforTargetElements))
targetWMunique = findUnique(WMforTargetElements_flat)

resultDict = {
"TargetElements": targetElements,
"TargetFamilyCode": targetFamilyCode,
"WMforTargetElements": WMforTargetElements,
"TargetWMunique": targetWMunique
}



result = resultDict

# Assign your output to the OUT variable.
OUT = result
# ----------------------------------------

code_block_5 = CodeBlock(i=select_target_family_element_and) { i; }

# group: Input Manager
value_for_import_from_others = CodeBlock(MainInput=code_block_5) { MainInput; RefInput1; RefInput2; }  # unwired: RefInput1, RefInput2

# group: <Func 1>Substructure Structural Concrete (M3)
code_block_6 = CodeBlock { "TargetElements"; }
# note: <Func>
valueAtKey = DesignScript.Builtin.Dictionary.ValueAtKey(dictionary=value_for_import_from_others.MainInput, key=code_block_6)
code_block_7 = CodeBlock { "M3"; }

watch = Watch(valueAtKey)
elementType = Element.ElementType(element=watch)
familyName = ElementType.FamilyName(elementType=elementType)
watch_2 = Watch(familyName)
string_from_object = FromObject(object=watch_2)
code_block_8 = CodeBlock { "Concrete"; }
contains = String.Contains(string=string_from_object, searchFor=code_block_8)
filterByBoolMask = List.FilterByBoolMask(list=valueAtKey, mask=contains)
watch_3 = Watch(filterByBoolMask.out)
name = FamilyType.Name(familyType=watch_3)
string_from_object_2 = FromObject(object=name)
code_block_9 = CodeBlock { "BH-"; }
contains_2 = String.Contains(string=string_from_object_2, searchFor=code_block_9)
filterByBoolMask_2 = List.FilterByBoolMask(list=watch_3, mask=contains_2)
watch_4 = Watch(filterByBoolMask_2.out)
watch_5 = Watch(filterByBoolMask.in)

# group: surface
watch_6 = Watch(watch_4)
geometry = Element.Geometry(element=watch_6)
watch_7 = Watch(geometry)
watch_8 = Watch(watch_5)
geometry_2 = Element.Geometry(element=watch_8)
watch_9 = Watch(geometry_2)
faces = Element.Faces(element=watch_8)
faces_2 = Element.Faces(element=watch_6)

flatten = List.Flatten(list=faces)
flatten_2 = List.Flatten(list=faces_2)
area = Surface.Area()  # unwired: surface
area_2 = Surface.Area()  # unwired: surface

# group: Unit Weight 추출 전
# note: 철골 모델링으로 확인
watch_10 = Watch()  # unwired: arg0
code_block_10 = CodeBlock(a=watch_10) { a[0]; }
parameters = Element.Parameters(element=code_block_10)
name_2 = Parameter.Name(parameter=parameters)
code_block_11 = CodeBlock { "Unit Weight"; "Weight"; "weight"; }
contains_3 = String.Contains(string=name_2, searchFor=code_block_11.out1)
countTrue = List.CountTrue(list=contains_3)
watch_11 = Watch(countTrue)
watch_12 = Watch()  # unwired: arg0

# note: Built up
watch_13 = Watch(filterByBoolMask_2.in)

# group: Unit weight x element length
code_block_12 = CodeBlock { "Length"; }
getParameterValueByName = Element.GetParameterValueByName(element=watch_10, parameterName=code_block_12)

code_block_13 = CodeBlock { UW; }  # unwired: UW
code_block_14 = CodeBlock { 90; 30; }
# note: Built up 제외외
ge = code_block_13 >= code_block_14.out0
lt = code_block_13 < code_block_14.out1
ge_2 = code_block_13 >= code_block_14.out1
# note: Built up 자제만
watch_14 = Watch(ge_2)
le = watch_14 <= code_block_14.out0

# group: Sample
code_block_15 = CodeBlock {  }
code_block_16 = CodeBlock {  }

# group: Primary Input
categories_2 = Categories("OST_StructuralFoundation")
all_elements_of_category_2 = ElementsOfCategory(Category=categories_2)
file_path_2 = Filename("..\BIM_물량집계 자동화 산출기준표_rC(20211029).xlsx")
file_from_path = FileObject(path=file_path_2)
code_block_17 = CodeBlock { "Str Foundations"; }

# group: GetFull WMCodeDescription PerElement
code_block_18 = CodeBlock(InputElement=all_elements_of_category_2, InputFilePath=file_from_path, InputSheetName=code_block_17) { _InputElement; _InputFilePath; _InputSheetName; }
excelDataManagerNode_2 = Python(IN[0]=code_block_18._InputElement, IN[1]=code_block_18._InputFilePath, IN[2]=code_block_18._InputSheetName)  # CPython3
# ---------- excelDataManagerNode_2.python (279 lines) ----------
# Load the Python Standard and DesignScript Libraries
import os
import sys
sys.path.append(os.getenv('LOCALAPPDATA').replace('\\','\\\\') + r'\Programs\Python\Python39\Lib\site-packages')
import clr
clr.AddReference('RevitAPI')
import Autodesk

clr.AddReference('ProtoGeometry')
from Autodesk.DesignScript.Geometry import *

clr.AddReference('RevitNodes')
import Revit
clr.ImportExtensions(Revit.Elements)

clr.ImportExtensions(Revit.GeometryConversion)
clr.ImportExtensions(Revit.GeometryReferences)

clr.AddReference('RevitServices')
import RevitServices
from RevitServices.Persistence import DocumentManager
from RevitServices.Transactions import TransactionManager

doc = DocumentManager.Instance.CurrentDBDocument

import random
import itertools
from functools import reduce
from collections import Iterable
import datetime
import openpyxl

def iterable(obj):
    return isinstance(obj, Iterable)

def findUnique(inputs):
    result = []
    for i in inputs:
        if i in result:
            pass
        else:
            result.append(i)
    return result

# The inputs to this node will be stored as a list in the IN variables.
dataEnteringNode = IN
inputElements = IN[0]
inputFilePath = IN[1]
inputSheetName = IN[2]

def importExcel(path, SheetNameIn):
    wb_obj = openpyxl.load_workbook(str(path), data_only=True)
    sheet_obj = wb_obj.get_sheet_by_name(str(SheetNameIn))

    m_row = sheet_obj.max_row
    m_col = sheet_obj.max_column

    listOut = []

    for i in range(1, m_row +1):
        listTemp = []
        for j in range(1, m_col + 1):
            cell_obj = sheet_obj.cell(row=i, column=j)
            listTemp.append(cell_obj.value)
            if len(listTemp) == m_col:
                listOut.append(listTemp)
    return listOut

def getUsedFamilyTypeOfModeling(elements):
    familyCode = list(map(lambda x: x.Name.split('_')[0], elements))
    unq_familyCode = findUnique(familyCode)
    return unq_familyCode
    
def createExcelDataDictionary(values):
    result = {}
    for i in range(len(values)):
        result[str(i)] = values[i]
    return result

def findTargetIndex(targets, list):
    result = []
    for target in targets:
        for i in range(len(list)):
            if target in str(list[i]):
                result.append(i)
            else:
                pass
    result.sort()
    return result
    
def GetValueAtKeys(keys, dictionary):
    result = [] 
    for i in keys:
        result.append(dictionary[str(i)])
    return result


# Place your code below this line
usedFamilyTypeOfModeling = getUsedFamilyTypeOfModeling(inputElements)
excelWholeDataSet = importExcel(inputFilePath, inputSheetName)
trExcelWholeDataSet = list(zip(*excelWholeDataSet))
excelColumnDataSet = createExcelDataDictionary(trExcelWholeDataSet)
excelRowDataSet = createExcelDataDictionary(excelWholeDataSet)
ColumnIndexOfUsedFamilyType = findTargetIndex(usedFamilyTypeOfModeling, trExcelWholeDataSet)
ColDataSetOfUsedFamilyType = GetValueAtKeys(ColumnIndexOfUsedFamilyType, excelColumnDataSet)
materialPerElementFromModeling = []
for i in inputElements:
    materialPerElementFromModeling.append(i.GetMaterials())
#list(map(lambda x: x.GetMaterials, inputElements)) "맵함수로 처리하면 리스트화 할 때 타입 변환 오류 남"

targetWMRowIndex = []
for i in ColDataSetOfUsedFamilyType:
    targetWMRowIndex.append(findTargetIndex(['000'], i))

rowDataSetOfUsedWM = []
for i in targetWMRowIndex:
    rowDataSetOfUsedWM.append(GetValueAtKeys(i, excelRowDataSet))

workGroup = []
for i in rowDataSetOfUsedWM:
    tmp = []
    for j in i:
        tmp.append(j[0])
    workGroup.append(tmp)
    
workMaster = []
for i in range(len(ColDataSetOfUsedFamilyType)):
    tmp=[]
    for k in targetWMRowIndex[i]:
        tmp.append(ColDataSetOfUsedFamilyType[i][k])
    workMaster.append(tmp)

matchedWM = []
for i in range(len(workGroup)):
    tmp = []
    for j in range(len(workGroup[i])):
        fullWM = workGroup[i][j] +"-"+ workMaster[i][j]
        tmp.append(fullWM)
    matchedWM.append(tmp)

matchedWorkGruopAndMasterCode = []
for i in matchedWM:
    if len(i) > 0:
        matchedWorkGruopAndMasterCode.append(i)
    else:
        pass

matchedWMDescription = []
for i in rowDataSetOfUsedWM:
    tmp=[]
    for j in i:
        tmp.append(j[1] +" "+ j[2] +" "+ j[3] +" "+ "("+ j[4] +")")
    if len(tmp) > 0:
        matchedWMDescription.append(tmp)
    else:
        pass

matchedWMUnit = []
for i in rowDataSetOfUsedWM:
    tmp=[]
    for j in i:
        tmp.append(j[4])
    if len(tmp) > 0:
        matchedWMUnit.append(tmp)
    else:
        pass

matchedWorkGruopAndMasterCode_flat = list(itertools.chain(*matchedWorkGruopAndMasterCode))
matchedWMDescription_flat = list(itertools.chain(*matchedWMDescription))

dic_WMandDescription_Excel = {}
for i in range(len(matchedWorkGruopAndMasterCode_flat)):
    dic_WMandDescription_Excel[matchedWorkGruopAndMasterCode_flat[i]] = matchedWMDescription_flat[i]

usedFamilyTypeInExcelOrder = list(map(lambda x: x[3], ColDataSetOfUsedFamilyType))
usedFamilyCodeInExcelOrder = findUnique(list(map(lambda x: x.split('_')[0], usedFamilyTypeInExcelOrder)))

dic_FamilyCodeandWM = {}
for i in range(len(usedFamilyCodeInExcelOrder)):
    dic_FamilyCodeandWM[usedFamilyCodeInExcelOrder[i]] = matchedWorkGruopAndMasterCode[i]

workMasterCodePerElement = []
familyCodePerElem = list(map(lambda x: x.Name.split('_')[0], inputElements))
for i in familyCodePerElem:
    workMasterCodePerElement.append(dic_FamilyCodeandWM[i])

materialNamePerElem = []
for i in materialPerElementFromModeling:
    tmp = []
    for j in i:
        tmp.append(j.Name)
    materialNamePerElem.append(tmp)

WMPerElementFromModeling = []
for i in materialNamePerElem:
    tmp = []
    for j in i:
        tmp.append(j.split('_')[0])
    WMPerElementFromModeling.append(tmp)

specPerElementFromModeling = []
for i in materialNamePerElem:
    tmp = []
    for j in i:
        a = j.split('_')
        del a[0]
        b = " ".join(a)
        tmp.append(b)
    specPerElementFromModeling.append(tmp)

WMPerElementFromModeling_flat = list(itertools.chain(*WMPerElementFromModeling))
specPerElementFromModeling_flat = list(itertools.chain(*specPerElementFromModeling))

dic_WMandDescription_Model = {}
for i in range(len(WMPerElementFromModeling_flat)):
    dic_WMandDescription_Model[WMPerElementFromModeling_flat[i]] = specPerElementFromModeling_flat[i]

def findAllKeys(dict):
    result = []
    for key in dict.keys():
        result.append(key)
    return result

def findAllValues(dict):
    result = []
    for key in dict.keys():
        result.append(dict[key])
    return result

keys_WMandDescription_Model = findAllKeys(dic_WMandDescription_Model)
keys_WMandDescription_Excel = findAllKeys(dic_WMandDescription_Excel)

keys_WMandDescription_Both = list(set(keys_WMandDescription_Model + keys_WMandDescription_Excel))
values_WMandDescription_Both = []
for i in keys_WMandDescription_Both:
    if i in keys_WMandDescription_Model:
        values_WMandDescription_Both.append(dic_WMandDescription_Model[i])
    else:
        values_WMandDescription_Both.append(dic_WMandDescription_Excel[i])

dic_WMandDescription_Both = {}
for i in range(len(keys_WMandDescription_Both)):
    dic_WMandDescription_Both[keys_WMandDescription_Both[i]] = values_WMandDescription_Both[i]

workMasterCodePerElementFromBoth = []
for i in range(len(workMasterCodePerElement)):
    #tmp = []
    a = WMPerElementFromModeling[i] + workMasterCodePerElement[i]
    b = findUnique(a)
    workMasterCodePerElementFromBoth.append(b)

specPerElement = []
for i in workMasterCodePerElementFromBoth:
    tmp = []
    for j in i:
        tmp.append(dic_WMandDescription_Both[j])
    specPerElement.append(tmp)

fullWMCodeDescriptionPerElement = []
for i in range(len(workMasterCodePerElementFromBoth)):
    tmp = []
    for j in range(len(workMasterCodePerElementFromBoth[i])):
        a = workMasterCodePerElementFromBoth[i][j] +": "+ specPerElement[i][j]
        tmp.append(a)
    fullWMCodeDescriptionPerElement.append(tmp)

fullWMinfo = {
"AllElement": inputElements,
"WorkMasterCodePerFamilyType": dic_FamilyCodeandWM,
"WorkMasterCodePerElementBoth": workMasterCodePerElementFromBoth,
"FullWMCodeDescriptionPerElement": fullWMCodeDescriptionPerElement
}



result = fullWMinfo

# Assign your output to the OUT variable.
OUT = result
# ----------------------------------------

# group: Organize AllElementInform AsDictionary
set_up_all_element_inform_as_2 = Python(IN[0]=excelDataManagerNode_2)  # "Set Up All Element Inform as Dictionary"; CPython3; same code as set_up_all_element_inform_as

# group: Select Target Family Element And Connected WorkMasters
code_block_19 = CodeBlock { 1; }
select_target_family_element_and_2 = Python(IN[0]=set_up_all_element_inform_as_2, IN[1]=code_block_19)  # "Select Target Family Element And Connected WorkMasters"; CPython3; same code as select_target_family_element_and

watch_15 = Watch(select_target_family_element_and_2)
code_block_20 = CodeBlock(i=watch_15) { i; }

# group: Input Manager
value_for_import_from_others_2 = CodeBlock(MainInput=code_block_20) { MainInput; RefInput1; RefInput2; }  # unwired: RefInput1, RefInput2

# group: <Func 9>Lean Concrete
code_block_21 = CodeBlock { "TargetElements"; }
valueAtKey_2 = DesignScript.Builtin.Dictionary.ValueAtKey(dictionary=value_for_import_from_others_2.MainInput, key=code_block_21)
code_block_22 = CodeBlock { 0; 100; }
# note: <Func>
createLeanConcrete = Custom[CreateLeanConcrete](Element=valueAtKey_2, leanOffset=code_block_22.out0, leanThick=code_block_22.out1)  # CreateLeanConcreteForISOFDN
volume = Solid.Volume(solid=createLeanConcrete.Solid)
code_block_23 = CodeBlock(i=volume) { Math.Round(List.Flatten(i)/1000000000, 2); }
code_block_24 = CodeBlock { "M3"; }
count = List.Count(list=code_block_23)
ofRepeatedItem = List.OfRepeatedItem(item=code_block_24, amount=count)
code_block_25 = CodeBlock(FuncValues=code_block_23, FuncValuesUnit=ofRepeatedItem)
# ---------- code_block_25.designscript (4 lines) ----------
{
"FuncValues": _FuncValues,
"FuncValuesUnit": _FuncValuesUnit
};
# ----------------------------------------

# group: Output Manager
output = CodeBlock(MainOutput=code_block_25, RefOutput_geoColor=createLeanConcrete.Solid) { MainOutput; RefOutput_geoColor; }
reference_output = CodeBlock(ref=createLeanConcrete.Solid) { ref; }

join = List.Join(list0=output.MainOutput)  # unwired: list1, list2, list3, list4, list5, list6, list7, list8, list9, list10

# group: TargetWMunique + Data Sending
code_block_26 = CodeBlock(InputDic2=join) { _InputDic2; }
count_2 = List.Count(list=code_block_26)
code_block_27 = CodeBlock(InputDic1=code_block_20) { _InputDic1; }
code_block_28 = CodeBlock { "TargetWMunique"; }
valueAtKey_3 = DesignScript.Builtin.Dictionary.ValueAtKey(dictionary=code_block_27, key=code_block_28)
watch_16 = Watch(valueAtKey_3)
count_3 = List.Count(list=watch_16)
eq = count_2 == count_3
organizeFuncValuesAndWorkMasterAsDiction = Custom[OrganizeFuncValuesAndWorkMasterAsDictionary](InputDic1=code_block_27, InputDic2=code_block_26)  # Organize FuncValues and WorkMaster As Dictionary
watch_17 = Watch()  # unwired: arg0
if_ = If(test=eq, true=organizeFuncValuesAndWorkMasterAsDiction, false=watch_17)

# group: Visual Manager
visual_켜기_끄기 = BoolSelector(false)
visual_manager = Python(IN[0]=output.RefOutput_geoColor, IN[1]=visual_켜기_끄기)  # CPython3
# ---------- visual_manager.python (18 lines) ----------
# Load the Python Standard and DesignScript Libraries
import sys
import clr
clr.AddReference('ProtoGeometry')
from Autodesk.DesignScript.Geometry import *

# The inputs to this node will be stored as a list in the IN variables.
dataEnteringNode = IN
geoColors = IN[0]
blnForVisual = IN[1]

# Place your code below this line
if blnForVisual == True:
    result = geoColors
else:
    result = 0
# Assign your output to the OUT variable.
OUT = result
# ----------------------------------------

# group: Sample
code_block_29 = CodeBlock {  }
code_block_30 = CodeBlock {  }

watch_18 = Watch(select_target_family_element_and)
geometry_3 = Element.Geometry(element=valueAtKey)

# group (continued): <Func 1>Substructure Structural Concrete (M3)
volume_2 = Solid.Volume(solid=geometry_3)
code_block_31 = CodeBlock(i=volume_2) { Math.Round(List.Flatten(i)/1000000000, 2); }
count_4 = List.Count(list=code_block_31)
ofRepeatedItem_2 = List.OfRepeatedItem(item=code_block_7, amount=count_4)
code_block_32 = CodeBlock(FuncValues=code_block_31, FuncValuesUnit=ofRepeatedItem_2)  # same code as code_block_25

# group: Output Manager
output_2 = CodeBlock(MainOutput=code_block_32) { MainOutput; RefOutput_geoColor; }  # unwired: RefOutput_geoColor
reference_output_2 = CodeBlock { ref; }  # unwired: ref

# group: Visual Manager
visual_켜기_끄기_2 = BoolSelector(false)
visual_manager_2 = Python(IN[0]=output_2.RefOutput_geoColor, IN[1]=visual_켜기_끄기_2)  # CPython3; same code as visual_manager

# group: Select Target Family Element And Connected WorkMasters
code_block_33 = CodeBlock { 1; }
select_target_family_element_and_3 = Python(IN[0]=set_up_all_element_inform_as, IN[1]=code_block_33)  # "Select Target Family Element And Connected WorkMasters"; CPython3; same code as select_target_family_element_and

watch_19 = Watch(select_target_family_element_and_3)

# group: Select Target Family Element And Connected WorkMasters
code_block_34 = CodeBlock { 2; }
select_target_family_element_and_4 = Python(IN[0]=set_up_all_element_inform_as, IN[1]=code_block_34)  # "Select Target Family Element And Connected WorkMasters"; CPython3; same code as select_target_family_element_and

watch_20 = Watch(select_target_family_element_and_4)

# group: Input Manager
value_for_import_from_others_3 = CodeBlock(MainInput=code_block_5) { MainInput; RefInput1; RefInput2; }  # unwired: RefInput1, RefInput2

# group: <Func 2>Substructure Form Work (M2)
code_block_35 = CodeBlock { "TargetElements"; }
valueAtKey_4 = DesignScript.Builtin.Dictionary.ValueAtKey(dictionary=value_for_import_from_others_3.MainInput, key=code_block_35)
# note: <Func>
extractSideFacesOfElement = Custom[ExtractSideFacesOfElement](Element=valueAtKey_4)  # ExtractSideFacesOfElement
getLocation = Element.GetLocation(element=valueAtKey_4)
direction = Line.Direction(line=getLocation)
code_block_36 = CodeBlock { 0.5; }
normalAtParameter = Surface.NormalAtParameter(surface=extractSideFacesOfElement.Surface, u=code_block_36, v=code_block_36)
isParallel = Vector.IsParallel(vector=direction, otherVector=normalAtParameter)
filterByBoolMask_3 = List.FilterByBoolMask(list=extractSideFacesOfElement.Surface, mask=isParallel)
area_3 = Surface.Area(surface=filterByBoolMask_3.out)
sum = Math.Sum(values=area_3)
code_block_37 = CodeBlock(i=sum) { Math.Round(List.Flatten(i)/1000000, 2); }
code_block_38 = CodeBlock { "M2"; }
count_5 = List.Count(list=code_block_37)
ofRepeatedItem_3 = List.OfRepeatedItem(item=code_block_38, amount=count_5)
code_block_39 = CodeBlock(FuncValues=code_block_37, FuncValuesUnit=ofRepeatedItem_3)  # same code as code_block_25

# group: Output Manager
reference_output_3 = CodeBlock { ref; }  # unwired: ref
output_3 = CodeBlock(MainOutput=code_block_39, RefOutput_geoColor=filterByBoolMask_3.out) { MainOutput; RefOutput_geoColor; }

# group: Visual Manager
visual_켜기_끄기_3 = BoolSelector(false)
visual_manager_3 = Python(IN[0]=output_3.RefOutput_geoColor, IN[1]=visual_켜기_끄기_3)  # CPython3; same code as visual_manager

# group: Input Manager
value_for_import_from_others_4 = CodeBlock(MainInput=code_block_5) { MainInput; RefInput1; RefInput2; }  # unwired: RefInput1, RefInput2

# group: <Func 3>Substructure Rebar Work
code_block_40 = CodeBlock { "TargetElements"; }
valueAtKey_5 = DesignScript.Builtin.Dictionary.ValueAtKey(dictionary=value_for_import_from_others_4.MainInput, key=code_block_40)
code_block_41 = CodeBlock { "Volume"; }
# note: <Func>
getParameterValueByName_2 = Element.GetParameterValueByName(element=valueAtKey_5, parameterName=code_block_41)
sog_철근비 = DoubleInput(0)  # graph input
mul = getParameterValueByName_2 * sog_철근비
code_block_42 = CodeBlock(i=mul) { Math.Round(List.Flatten(i)/1, 2); }
code_block_43 = CodeBlock { "TON"; }
count_6 = List.Count(list=code_block_42)
ofRepeatedItem_4 = List.OfRepeatedItem(item=code_block_43, amount=count_6)
code_block_44 = CodeBlock(FuncValues=code_block_42, FuncValuesUnit=ofRepeatedItem_4)  # same code as code_block_25

# group: Output Manager
reference_output_4 = CodeBlock { ref; }  # unwired: ref
output_4 = CodeBlock(MainOutput=code_block_44) { MainOutput; RefOutput_geoColor; }  # unwired: RefOutput_geoColor

# group: Input Manager
value_for_import_from_others_5 = CodeBlock(MainInput=code_block_5) { MainInput; RefInput1; RefInput2; }  # unwired: RefInput1, RefInput2

# group: <Func 4>Concrete Protective Coating (U/G)
code_block_45 = CodeBlock { "TargetElements"; }
valueAtKey_6 = DesignScript.Builtin.Dictionary.ValueAtKey(dictionary=value_for_import_from_others_5.MainInput, key=code_block_45)
# note: <Func>
extractSideFacesOfElement_2 = Custom[ExtractSideFacesOfElement](Element=valueAtKey_6)
getLocation_2 = Element.GetLocation(element=valueAtKey_6)
direction_2 = Line.Direction(line=getLocation_2)
code_block_46 = CodeBlock { 0.5; }
normalAtParameter_2 = Surface.NormalAtParameter(surface=extractSideFacesOfElement_2.Surface, u=code_block_46, v=code_block_46)
isParallel_2 = Vector.IsParallel(vector=direction_2, otherVector=normalAtParameter_2)
filterByBoolMask_4 = List.FilterByBoolMask(list=extractSideFacesOfElement_2.Surface, mask=isParallel_2)
area_4 = Surface.Area(surface=filterByBoolMask_4.out)
sum_2 = Math.Sum(values=area_4)
code_block_47 = CodeBlock(i=sum_2) { Math.Round(List.Flatten(i)/1000000, 2); }
code_block_48 = CodeBlock { "M2"; }
count_7 = List.Count(list=code_block_47)
ofRepeatedItem_5 = List.OfRepeatedItem(item=code_block_48, amount=count_7)
code_block_49 = CodeBlock(FuncValues=code_block_47, FuncValuesUnit=ofRepeatedItem_5)  # same code as code_block_25

# group: Output Manager
reference_output_5 = CodeBlock { ref; }  # unwired: ref
output_5 = CodeBlock(MainOutput=code_block_49, RefOutput_geoColor=filterByBoolMask_4.out) { MainOutput; RefOutput_geoColor; }

# group: Visual Manager
visual_켜기_끄기_4 = BoolSelector(false)
visual_manager_4 = Python(IN[0]=output_5.RefOutput_geoColor, IN[1]=visual_켜기_끄기_4)  # CPython3; same code as visual_manager

code_block_50 = CodeBlock(i=select_target_family_element_and_3) { i; }
code_block_51 = CodeBlock(i=code_block_50) { i; }

# group: Input Manager
value_for_import_from_others_6 = CodeBlock(MainInput=code_block_51) { MainInput; RefInput1; RefInput2; }  # unwired: RefInput1, RefInput2

# group: <Func 3>Superstructure Rebar Work
code_block_52 = CodeBlock { "TargetElements"; }
valueAtKey_7 = DesignScript.Builtin.Dictionary.ValueAtKey(dictionary=value_for_import_from_others_6.MainInput, key=code_block_52)
code_block_53 = CodeBlock { "Volume"; }
# note: <Func>
getParameterValueByName_3 = Element.GetParameterValueByName(element=valueAtKey_7, parameterName=code_block_53)
sog_철근비_2 = DoubleInput(0)  # graph input
mul_2 = getParameterValueByName_3 * sog_철근비_2
code_block_54 = CodeBlock(i=mul_2) { Math.Round(List.Flatten(i)/1, 2); }
code_block_55 = CodeBlock { "TON"; }
count_8 = List.Count(list=code_block_54)
ofRepeatedItem_6 = List.OfRepeatedItem(item=code_block_55, amount=count_8)
code_block_56 = CodeBlock(FuncValues=code_block_54, FuncValuesUnit=ofRepeatedItem_6)  # same code as code_block_25

# group: Output Manager
reference_output_6 = CodeBlock { ref; }  # unwired: ref
output_6 = CodeBlock(MainOutput=code_block_56) { MainOutput; RefOutput_geoColor; }  # unwired: RefOutput_geoColor

# group: Input Manager
value_for_import_from_others_7 = CodeBlock(MainInput=code_block_51) { MainInput; RefInput1; RefInput2; }  # unwired: RefInput1, RefInput2

# group: <Func 2>Superstructure Form Work
# note: 하단 폼 추가
code_block_57 = CodeBlock { "TargetElements"; }
valueAtKey_8 = DesignScript.Builtin.Dictionary.ValueAtKey(dictionary=value_for_import_from_others_7.MainInput, key=code_block_57)
# note: <Func>
extractSideFacesOfElement_3 = Custom[ExtractSideFacesOfElement](Element=valueAtKey_8)
getLocation_3 = Element.GetLocation(element=valueAtKey_8)
direction_3 = Line.Direction(line=getLocation_3)
code_block_58 = CodeBlock { 0.5; }
normalAtParameter_3 = Surface.NormalAtParameter(surface=extractSideFacesOfElement_3.Surface, u=code_block_58, v=code_block_58)
isParallel_3 = Vector.IsParallel(vector=direction_3, otherVector=normalAtParameter_3)
filterByBoolMask_5 = List.FilterByBoolMask(list=extractSideFacesOfElement_3.Surface, mask=isParallel_3)
area_5 = Surface.Area(surface=filterByBoolMask_5.out)
sum_3 = Math.Sum(values=area_5)
code_block_59 = CodeBlock(i=sum_3) { Math.Round(List.Flatten(i)/1000000, 2); }
code_block_60 = CodeBlock { "M2"; }
count_9 = List.Count(list=code_block_59)
ofRepeatedItem_7 = List.OfRepeatedItem(item=code_block_60, amount=count_9)
code_block_61 = CodeBlock(FuncValues=code_block_59, FuncValuesUnit=ofRepeatedItem_7)  # same code as code_block_25

# group: Output Manager
output_7 = CodeBlock(MainOutput=code_block_61, RefOutput_geoColor=filterByBoolMask_5.out) { MainOutput; RefOutput_geoColor; }
reference_output_7 = CodeBlock { ref; }  # unwired: ref

# group: Visual Manager
visual_켜기_끄기_5 = BoolSelector(false)
visual_manager_5 = Python(IN[0]=output_7.RefOutput_geoColor, IN[1]=visual_켜기_끄기_5)  # CPython3; same code as visual_manager

# group: Input Manager
value_for_import_from_others_8 = CodeBlock(MainInput=code_block_51) { MainInput; RefInput1; RefInput2; }  # unwired: RefInput1, RefInput2

# group: <Func 1>Superstructure Concrete (M3)
code_block_62 = CodeBlock { "TargetElements"; }
# note: <Func>
valueAtKey_9 = DesignScript.Builtin.Dictionary.ValueAtKey(dictionary=value_for_import_from_others_8.MainInput, key=code_block_62)
code_block_63 = CodeBlock { "M3"; }

geometry_4 = Element.Geometry(element=valueAtKey_9)

# group (continued): <Func 1>Superstructure Concrete (M3)
volume_3 = Solid.Volume(solid=geometry_4)
code_block_64 = CodeBlock(i=volume_3) { Math.Round(List.Flatten(i)/1000000000, 2); }
count_10 = List.Count(list=code_block_64)
ofRepeatedItem_8 = List.OfRepeatedItem(item=code_block_63, amount=count_10)
code_block_65 = CodeBlock(FuncValues=code_block_64, FuncValuesUnit=ofRepeatedItem_8)  # same code as code_block_25

# group: Output Manager
output_8 = CodeBlock(MainOutput=code_block_65) { MainOutput; RefOutput_geoColor; }  # unwired: RefOutput_geoColor
reference_output_8 = CodeBlock { ref; }  # unwired: ref

# group: Visual Manager
visual_켜기_끄기_6 = BoolSelector(false)
visual_manager_6 = Python(IN[0]=output_8.RefOutput_geoColor, IN[1]=visual_켜기_끄기_6)  # CPython3; same code as visual_manager

code_block_66 = CodeBlock(i=select_target_family_element_and_4) { i; }
code_block_67 = CodeBlock(i=code_block_66) { i; }

# group: Input Manager
value_for_import_from_others_9 = CodeBlock(MainInput=code_block_67) { MainInput; RefInput1; RefInput2; }  # unwired: RefInput1, RefInput2

# group: <Func 3>Superstructure Rebar Work
code_block_68 = CodeBlock { "TargetElements"; }
valueAtKey_10 = DesignScript.Builtin.Dictionary.ValueAtKey(dictionary=value_for_import_from_others_9.MainInput, key=code_block_68)
code_block_69 = CodeBlock { "Volume"; }
# note: <Func>
getParameterValueByName_4 = Element.GetParameterValueByName(element=valueAtKey_10, parameterName=code_block_69)
sog_철근비_3 = DoubleInput(0)  # graph input
mul_3 = getParameterValueByName_4 * sog_철근비_3
code_block_70 = CodeBlock(i=mul_3) { Math.Round(List.Flatten(i)/1, 2); }
code_block_71 = CodeBlock { "TON"; }
count_11 = List.Count(list=code_block_70)
ofRepeatedItem_9 = List.OfRepeatedItem(item=code_block_71, amount=count_11)
code_block_72 = CodeBlock(FuncValues=code_block_70, FuncValuesUnit=ofRepeatedItem_9)  # same code as code_block_25

# group: Output Manager
reference_output_9 = CodeBlock { ref; }  # unwired: ref
output_9 = CodeBlock(MainOutput=code_block_72) { MainOutput; RefOutput_geoColor; }  # unwired: RefOutput_geoColor

# group: Input Manager
value_for_import_from_others_10 = CodeBlock(MainInput=code_block_67) { MainInput; RefInput1; RefInput2; }  # unwired: RefInput1, RefInput2

# group: <Func 2>Superstructure Form Work (M2)
# note: 하단 폼 추가
code_block_73 = CodeBlock { "TargetElements"; }
valueAtKey_11 = DesignScript.Builtin.Dictionary.ValueAtKey(dictionary=value_for_import_from_others_10.MainInput, key=code_block_73)
# note: <Func>
extractSideFacesOfElement_4 = Custom[ExtractSideFacesOfElement](Element=valueAtKey_11)
getLocation_4 = Element.GetLocation(element=valueAtKey_11)
direction_4 = Line.Direction(line=getLocation_4)
code_block_74 = CodeBlock { 0.5; }
normalAtParameter_4 = Surface.NormalAtParameter(surface=extractSideFacesOfElement_4.Surface, u=code_block_74, v=code_block_74)
isParallel_4 = Vector.IsParallel(vector=direction_4, otherVector=normalAtParameter_4)
filterByBoolMask_6 = List.FilterByBoolMask(list=extractSideFacesOfElement_4.Surface, mask=isParallel_4)
area_6 = Surface.Area(surface=filterByBoolMask_6.out)
sum_4 = Math.Sum(values=area_6)
code_block_75 = CodeBlock(i=sum_4) { Math.Round(List.Flatten(i)/1000000, 2); }
code_block_76 = CodeBlock { "M2"; }
count_12 = List.Count(list=code_block_75)
ofRepeatedItem_10 = List.OfRepeatedItem(item=code_block_76, amount=count_12)
code_block_77 = CodeBlock(FuncValues=code_block_75, FuncValuesUnit=ofRepeatedItem_10)  # same code as code_block_25

# group: Output Manager
reference_output_10 = CodeBlock { ref; }  # unwired: ref
output_10 = CodeBlock(MainOutput=code_block_77, RefOutput_geoColor=filterByBoolMask_6.out) { MainOutput; RefOutput_geoColor; }

# group: Visual Manager
visual_켜기_끄기_7 = BoolSelector(false)
visual_manager_7 = Python(IN[0]=output_10.RefOutput_geoColor, IN[1]=visual_켜기_끄기_7)  # CPython3; same code as visual_manager

# group: Input Manager
value_for_import_from_others_11 = CodeBlock(MainInput=code_block_67) { MainInput; RefInput1; RefInput2; }  # unwired: RefInput1, RefInput2

# group: <Func 1>Superstructure Structural Concrete (M3)
code_block_78 = CodeBlock { "TargetElements"; }
# note: <Func>
valueAtKey_12 = DesignScript.Builtin.Dictionary.ValueAtKey(dictionary=value_for_import_from_others_11.MainInput, key=code_block_78)
code_block_79 = CodeBlock { "M3"; }

geometry_5 = Element.Geometry(element=valueAtKey_12)

# group (continued): <Func 1>Superstructure Structural Concrete (M3)
volume_4 = Solid.Volume(solid=geometry_5)
code_block_80 = CodeBlock(i=volume_4) { Math.Round(List.Flatten(i)/1000000000, 2); }
count_13 = List.Count(list=code_block_80)
ofRepeatedItem_11 = List.OfRepeatedItem(item=code_block_79, amount=count_13)
code_block_81 = CodeBlock(FuncValues=code_block_80, FuncValuesUnit=ofRepeatedItem_11)  # same code as code_block_25

# group: Output Manager
reference_output_11 = CodeBlock { ref; }  # unwired: ref
output_11 = CodeBlock(MainOutput=code_block_81) { MainOutput; RefOutput_geoColor; }  # unwired: RefOutput_geoColor

# group: Visual Manager
visual_켜기_끄기_8 = BoolSelector(false)
visual_manager_8 = Python(IN[0]=output_11.RefOutput_geoColor, IN[1]=visual_켜기_끄기_8)  # CPython3; same code as visual_manager

# group: Select Target Family Element And Connected WorkMasters
code_block_82 = CodeBlock { 3; }
select_target_family_element_and_5 = Python(IN[0]=set_up_all_element_inform_as, IN[1]=code_block_82)  # "Select Target Family Element And Connected WorkMasters"; CPython3; same code as select_target_family_element_and

watch_21 = Watch(select_target_family_element_and_5)
code_block_83 = CodeBlock(i=select_target_family_element_and_5) { i; }

# group: Output Manager
output_12 = CodeBlock { MainOutput; RefOutput_geoColor; }  # unwired: MainOutput, RefOutput_geoColor
reference_output_12 = CodeBlock { ref; }  # unwired: ref

# group: Visual Manager
visual_켜기_끄기_9 = BoolSelector(false)
visual_manager_9 = Python(IN[0]=output_12.RefOutput_geoColor, IN[1]=visual_켜기_끄기_9)  # CPython3; same code as visual_manager

# group: Output Manager
output_13 = CodeBlock { MainOutput; RefOutput_geoColor; }  # unwired: MainOutput, RefOutput_geoColor
reference_output_13 = CodeBlock { ref; }  # unwired: ref

# group: Visual Manager
visual_켜기_끄기_10 = BoolSelector(false)
visual_manager_10 = Python(IN[0]=output_13.RefOutput_geoColor, IN[1]=visual_켜기_끄기_10)  # CPython3; same code as visual_manager

# group: Output Manager
output_14 = CodeBlock { MainOutput; RefOutput_geoColor; }  # unwired: MainOutput, RefOutput_geoColor
reference_output_14 = CodeBlock { ref; }  # unwired: ref

# group: Visual Manager
visual_켜기_끄기_11 = BoolSelector(false)
visual_manager_11 = Python(IN[0]=output_14.RefOutput_geoColor, IN[1]=visual_켜기_끄기_11)  # CPython3; same code as visual_manager

# group: Output Manager
output_15 = CodeBlock { MainOutput; RefOutput_geoColor; }  # unwired: MainOutput, RefOutput_geoColor
reference_output_15 = CodeBlock { ref; }  # unwired: ref

# group: Visual Manager
visual_켜기_끄기_12 = BoolSelector(false)
visual_manager_12 = Python(IN[0]=output_15.RefOutput_geoColor, IN[1]=visual_켜기_끄기_12)  # CPython3; same code as visual_manager

code_block_84 = CodeBlock { i; }  # unwired: i

# group: Input Manager
value_for_import_from_others_12 = CodeBlock(MainInput=code_block_84) { MainInput; RefInput1; RefInput2; }  # unwired: RefInput1, RefInput2

# group: <Func 4> Steel Structure Strength Bolt&Nuts
code_block_85 = CodeBlock { "TargetElements"; }
# note: <Func>
valueAtKey_13 = DesignScript.Builtin.Dictionary.ValueAtKey(dictionary=value_for_import_from_others_12.MainInput, key=code_block_85)

# group: Input Manager
value_for_import_from_others_13 = CodeBlock(MainInput=code_block_84) { MainInput; RefInput1; RefInput2; }  # unwired: RefInput1, RefInput2

# group: <Func 3> Steel Structure Painting/Coating
code_block_86 = CodeBlock { "TargetElements"; }
# note: <Func>
valueAtKey_14 = DesignScript.Builtin.Dictionary.ValueAtKey(dictionary=value_for_import_from_others_13.MainInput, key=code_block_86)

# group: Input Manager
value_for_import_from_others_14 = CodeBlock(MainInput=code_block_84) { MainInput; RefInput1; RefInput2; }  # unwired: RefInput1, RefInput2

# group: <Func 10> Steel Structure Fire Proofing Work
code_block_87 = CodeBlock { "TargetElements"; }
# note: <Func>
valueAtKey_15 = DesignScript.Builtin.Dictionary.ValueAtKey(dictionary=value_for_import_from_others_14.MainInput, key=code_block_87)

# group: Input Manager
value_for_import_from_others_15 = CodeBlock(MainInput=code_block_84) { MainInput; RefInput1; RefInput2; }  # unwired: RefInput1, RefInput2

# group: <Func 6> Steel Structure Painting
code_block_88 = CodeBlock { "TargetElements"; }
# note: <Func>
valueAtKey_16 = DesignScript.Builtin.Dictionary.ValueAtKey(dictionary=value_for_import_from_others_15.MainInput, key=code_block_88)

# group: Output Manager
output_16 = CodeBlock { MainOutput; RefOutput_geoColor; }  # unwired: MainOutput, RefOutput_geoColor
reference_output_16 = CodeBlock { ref; }  # unwired: ref

# group: Visual Manager
visual_켜기_끄기_13 = BoolSelector(false)
visual_manager_13 = Python(IN[0]=output_16.RefOutput_geoColor, IN[1]=visual_켜기_끄기_13)  # CPython3; same code as visual_manager

# group: Input Manager
value_for_import_from_others_16 = CodeBlock(MainInput=code_block_84) { MainInput; RefInput1; RefInput2; }  # unwired: RefInput1, RefInput2

# group: <Func 5> Steel Structure Weight
code_block_89 = CodeBlock { "TargetElements"; }
# note: <Func>
valueAtKey_17 = DesignScript.Builtin.Dictionary.ValueAtKey(dictionary=value_for_import_from_others_16.MainInput, key=code_block_89)

# group: Output Manager
output_17 = CodeBlock { MainOutput; RefOutput_geoColor; }  # unwired: MainOutput, RefOutput_geoColor
reference_output_17 = CodeBlock { ref; }  # unwired: ref

# group: Visual Manager
visual_켜기_끄기_14 = BoolSelector(false)
visual_manager_14 = Python(IN[0]=output_17.RefOutput_geoColor, IN[1]=visual_켜기_끄기_14)  # CPython3; same code as visual_manager

# group: Output Manager
output_18 = CodeBlock { MainOutput; RefOutput_geoColor; }  # unwired: MainOutput, RefOutput_geoColor
reference_output_18 = CodeBlock { ref; }  # unwired: ref

# group: Visual Manager
visual_켜기_끄기_15 = BoolSelector(false)
visual_manager_15 = Python(IN[0]=output_18.RefOutput_geoColor, IN[1]=visual_켜기_끄기_15)  # CPython3; same code as visual_manager

# group: Input Manager
value_for_import_from_others_17 = CodeBlock(MainInput=code_block_84) { MainInput; RefInput1; RefInput2; }  # unwired: RefInput1, RefInput2

# group: <Func 1> Steel Structure Weight
code_block_90 = CodeBlock { "TargetElements"; }
# note: <Func>
valueAtKey_18 = DesignScript.Builtin.Dictionary.ValueAtKey(dictionary=value_for_import_from_others_17.MainInput, key=code_block_90)

# group: Input Manager
value_for_import_from_others_18 = CodeBlock(MainInput=code_block_84) { MainInput; RefInput1; RefInput2; }  # unwired: RefInput1, RefInput2

# group: <Func 2> Steel Structure Plates
code_block_91 = CodeBlock { "TargetElements"; }
# note: <Func>
valueAtKey_19 = DesignScript.Builtin.Dictionary.ValueAtKey(dictionary=value_for_import_from_others_18.MainInput, key=code_block_91)

# group: Select Target Family Element And Connected WorkMasters
code_block_92 = CodeBlock { 4; }
select_target_family_element_and_6 = Python(IN[0]=set_up_all_element_inform_as, IN[1]=code_block_92)  # "Select Target Family Element And Connected WorkMasters"; CPython3; same code as select_target_family_element_and

code_block_93 = CodeBlock(i=select_target_family_element_and_6) { i; }
watch_22 = Watch(select_target_family_element_and_6)

# group: Output Manager
output_19 = CodeBlock { MainOutput; RefOutput_geoColor; }  # unwired: MainOutput, RefOutput_geoColor
reference_output_19 = CodeBlock { ref; }  # unwired: ref

# group: Visual Manager
visual_켜기_끄기_16 = BoolSelector(false)
visual_manager_16 = Python(IN[0]=output_19.RefOutput_geoColor, IN[1]=visual_켜기_끄기_16)  # CPython3; same code as visual_manager

# group: Output Manager
output_20 = CodeBlock { MainOutput; RefOutput_geoColor; }  # unwired: MainOutput, RefOutput_geoColor
reference_output_20 = CodeBlock { ref; }  # unwired: ref

# group: Visual Manager
visual_켜기_끄기_17 = BoolSelector(false)
visual_manager_17 = Python(IN[0]=output_20.RefOutput_geoColor, IN[1]=visual_켜기_끄기_17)  # CPython3; same code as visual_manager

# group: Output Manager
output_21 = CodeBlock { MainOutput; RefOutput_geoColor; }  # unwired: MainOutput, RefOutput_geoColor
reference_output_21 = CodeBlock { ref; }  # unwired: ref

# group: Visual Manager
visual_켜기_끄기_18 = BoolSelector(false)
visual_manager_18 = Python(IN[0]=output_21.RefOutput_geoColor, IN[1]=visual_켜기_끄기_18)  # CPython3; same code as visual_manager

code_block_94 = CodeBlock { i; }  # unwired: i

# group: Input Manager
value_for_import_from_others_19 = CodeBlock(MainInput=code_block_94) { MainInput; RefInput1; RefInput2; }  # unwired: RefInput1, RefInput2

# group: <Func 3> Steel Structure Common Bolt&Nuts
code_block_95 = CodeBlock { "TargetElements"; }
# note: <Func>
valueAtKey_20 = DesignScript.Builtin.Dictionary.ValueAtKey(dictionary=value_for_import_from_others_19.MainInput, key=code_block_95)

# group: Input Manager
value_for_import_from_others_20 = CodeBlock(MainInput=code_block_94) { MainInput; RefInput1; RefInput2; }  # unwired: RefInput1, RefInput2

# group: <Func 2> Steel Structure Painting/Coating
code_block_96 = CodeBlock { "TargetElements"; }
# note: <Func>
valueAtKey_21 = DesignScript.Builtin.Dictionary.ValueAtKey(dictionary=value_for_import_from_others_20.MainInput, key=code_block_96)

# group: Input Manager
value_for_import_from_others_21 = CodeBlock(MainInput=code_block_94) { MainInput; RefInput1; RefInput2; }  # unwired: RefInput1, RefInput2

# group: <Func 4> Steel Structure Girth & Purlin
code_block_97 = CodeBlock { "TargetElements"; }
# note: <Func>
valueAtKey_22 = DesignScript.Builtin.Dictionary.ValueAtKey(dictionary=value_for_import_from_others_21.MainInput, key=code_block_97)

# group: Output Manager
output_22 = CodeBlock { MainOutput; RefOutput_geoColor; }  # unwired: MainOutput, RefOutput_geoColor
reference_output_22 = CodeBlock { ref; }  # unwired: ref

# group: Visual Manager
visual_켜기_끄기_19 = BoolSelector(false)
visual_manager_19 = Python(IN[0]=output_22.RefOutput_geoColor, IN[1]=visual_켜기_끄기_19)  # CPython3; same code as visual_manager

# group: Input Manager
value_for_import_from_others_22 = CodeBlock(MainInput=code_block_94) { MainInput; RefInput1; RefInput2; }  # unwired: RefInput1, RefInput2

# group: <Func 1> Steel Structure Girth & Purlin
code_block_98 = CodeBlock { "TargetElements"; }
# note: <Func>
valueAtKey_23 = DesignScript.Builtin.Dictionary.ValueAtKey(dictionary=value_for_import_from_others_22.MainInput, key=code_block_98)

# group: Output Manager
output_23 = CodeBlock { MainOutput; RefOutput_geoColor; }  # unwired: MainOutput, RefOutput_geoColor
reference_output_23 = CodeBlock { ref; }  # unwired: ref

# group: Visual Manager
visual_켜기_끄기_20 = BoolSelector(false)
visual_manager_20 = Python(IN[0]=output_23.RefOutput_geoColor, IN[1]=visual_켜기_끄기_20)  # CPython3; same code as visual_manager

# group: Input Manager
value_for_import_from_others_23 = CodeBlock(MainInput=code_block_94) { MainInput; RefInput1; RefInput2; }  # unwired: RefInput1, RefInput2

# group: <Func 5> Steel Structure Painting
code_block_99 = CodeBlock { "TargetElements"; }
# note: <Func>
valueAtKey_24 = DesignScript.Builtin.Dictionary.ValueAtKey(dictionary=value_for_import_from_others_23.MainInput, key=code_block_99)

# group: Select Target Family Element And Connected WorkMasters
code_block_100 = CodeBlock { 5; }
select_target_family_element_and_7 = Python(IN[0]=set_up_all_element_inform_as, IN[1]=code_block_100)  # "Select Target Family Element And Connected WorkMasters"; CPython3; same code as select_target_family_element_and

watch_23 = Watch(select_target_family_element_and_7)

# group: Output Manager
output_24 = CodeBlock { MainOutput; RefOutput_geoColor; }  # unwired: MainOutput, RefOutput_geoColor
reference_output_24 = CodeBlock { ref; }  # unwired: ref

# group: Visual Manager
visual_켜기_끄기_21 = BoolSelector(false)
visual_manager_21 = Python(IN[0]=output_24.RefOutput_geoColor, IN[1]=visual_켜기_끄기_21)  # CPython3; same code as visual_manager

code_block_101 = CodeBlock(i=select_target_family_element_and_7) { i; }

# group: Input Manager
value_for_import_from_others_24 = CodeBlock(MainInput=code_block_101) { MainInput; RefInput1; RefInput2; }  # unwired: RefInput1, RefInput2

# group: <Func 5> Steel Structure Painting
code_block_102 = CodeBlock { "TargetElements"; }
# note: <Func>
valueAtKey_25 = DesignScript.Builtin.Dictionary.ValueAtKey(dictionary=value_for_import_from_others_24.MainInput, key=code_block_102)

# group: Input Manager
value_for_import_from_others_25 = CodeBlock(MainInput=code_block_101) { MainInput; RefInput1; RefInput2; }  # unwired: RefInput1, RefInput2

# group: <Func 4> Steel Structure Weight
code_block_103 = CodeBlock { "TargetElements"; }
# note: <Func>
valueAtKey_26 = DesignScript.Builtin.Dictionary.ValueAtKey(dictionary=value_for_import_from_others_25.MainInput, key=code_block_103)

# group: Output Manager
reference_output_25 = CodeBlock { ref; }  # unwired: ref
output_25 = CodeBlock { MainOutput; RefOutput_geoColor; }  # unwired: MainOutput, RefOutput_geoColor

# group: Output Manager
output_26 = CodeBlock { MainOutput; RefOutput_geoColor; }  # unwired: MainOutput, RefOutput_geoColor
reference_output_26 = CodeBlock { ref; }  # unwired: ref

# group: Visual Manager
visual_켜기_끄기_22 = BoolSelector(false)
visual_manager_22 = Python(IN[0]=output_26.RefOutput_geoColor, IN[1]=visual_켜기_끄기_22)  # CPython3; same code as visual_manager

# group: Input Manager
value_for_import_from_others_26 = CodeBlock(MainInput=code_block_101) { MainInput; RefInput1; RefInput2; }  # unwired: RefInput1, RefInput2

# group: <Func 2> Steel Structure Painting/Coating
code_block_104 = CodeBlock { "TargetElements"; }
# note: <Func>
valueAtKey_27 = DesignScript.Builtin.Dictionary.ValueAtKey(dictionary=value_for_import_from_others_26.MainInput, key=code_block_104)

# group: Output Manager
output_27 = CodeBlock { MainOutput; RefOutput_geoColor; }  # unwired: MainOutput, RefOutput_geoColor
reference_output_27 = CodeBlock { ref; }  # unwired: ref

# group: Visual Manager
visual_켜기_끄기_23 = BoolSelector(false)
visual_manager_23 = Python(IN[0]=output_27.RefOutput_geoColor, IN[1]=visual_켜기_끄기_23)  # CPython3; same code as visual_manager

# group: Input Manager
value_for_import_from_others_27 = CodeBlock(MainInput=code_block_101) { MainInput; RefInput1; RefInput2; }  # unwired: RefInput1, RefInput2

# group: <Func 1> Steel Structure Weight
code_block_105 = CodeBlock { "TargetElements"; }
# note: <Func>
valueAtKey_28 = DesignScript.Builtin.Dictionary.ValueAtKey(dictionary=value_for_import_from_others_27.MainInput, key=code_block_105)

# group: Output Manager
output_28 = CodeBlock { MainOutput; RefOutput_geoColor; }  # unwired: MainOutput, RefOutput_geoColor
reference_output_28 = CodeBlock { ref; }  # unwired: ref

# group: Visual Manager
visual_켜기_끄기_24 = BoolSelector(false)
visual_manager_24 = Python(IN[0]=output_28.RefOutput_geoColor, IN[1]=visual_켜기_끄기_24)  # CPython3; same code as visual_manager

# group: Input Manager
value_for_import_from_others_28 = CodeBlock(MainInput=code_block_101) { MainInput; RefInput1; RefInput2; }  # unwired: RefInput1, RefInput2

# group: <Func 3> Steel Structure Strength Bolt&Nuts
code_block_106 = CodeBlock { "TargetElements"; }
# note: <Func>
valueAtKey_29 = DesignScript.Builtin.Dictionary.ValueAtKey(dictionary=value_for_import_from_others_28.MainInput, key=code_block_106)

# group: Visual Manager
visual_켜기_끄기_25 = BoolSelector(false)
visual_manager_25 = Python(IN[0]=output_25.RefOutput_geoColor, IN[1]=visual_켜기_끄기_25)  # CPython3; same code as visual_manager
