# Dynamo graph 06 Wall (1220).dyn (Dynamo 2.12.0.5650)

# group: select all Category element
categories = Categories("OST_Walls")
all_elements_of_category = ElementsOfCategory(Category=categories)

# group: select all Category element by level
code_block = CodeBlock { "Base Constraint"; }
getParameterValueByName = Element.GetParameterValueByName(parameterName=code_block)  # unwired: element
groupByFunction = List.GroupByFunction(list=all_elements_of_category, groupFunction=getParameterValueByName)

# group: Family Type 별 sorting
elementType = Element.ElementType()  # unwired: element
uniqueItems = List.UniqueItems(list=elementType)
groupByFunction_2 = List.GroupByFunction(list=groupByFunction@L2, groupFunction=uniqueItems)

# group: element-wm 별 면적(m2) 물량 추출 구간
code_block_2 = CodeBlock { "Area"; }
getParameterValueByName_2 = Element.GetParameterValueByName(element=groupByFunction_2, parameterName=code_block_2)
flatten = List.Flatten(list=getParameterValueByName_2)
watch = Watch(flatten)
getMaterials = Element.GetMaterials(element=groupByFunction_2)
count = List.Count(list=getMaterials@L2)
ofRepeatedItem = List.OfRepeatedItem(item=watch, amount=count, lacing=Shortest)
flatten_2 = List.Flatten(list=ofRepeatedItem)

watch_2 = Watch(flatten_2)
watch_3 = Watch(getMaterials)
name = Material.Name(material=watch_3)
watch_4 = Watch(name)
flatten_3 = List.Flatten(list=watch_4)

# group: input list 에서 대상문자열들 포함하는 index 추출(for line base)
대상_문자열 = CodeBlock()
# ---------- 대상_문자열.designscript (5 lines) ----------
[

"Skirt"

];
# ----------------------------------------
code_block_3 = CodeBlock(str=flatten_3, searchFor=대상_문자열) { String.Contains(str<1>, searchFor, false); }
allFalse = List.AllFalse(list=code_block_3@L2)
code_block_4 = CodeBlock { false; }
allIndicesOf = List.AllIndicesOf(list=allFalse, item=code_block_4)

# group: element-wm 별 길이(m) 물량 추출 구간
code_block_5 = CodeBlock { "Length"; }
getParameterValueByName_3 = Element.GetParameterValueByName(element=groupByFunction_2, parameterName=code_block_5)
flatten_4 = List.Flatten(list=getParameterValueByName_3)
watch_5 = Watch(flatten_4)
getMaterials_2 = Element.GetMaterials(element=groupByFunction_2)
count_2 = List.Count(list=getMaterials_2@L2)
ofRepeatedItem_2 = List.OfRepeatedItem(item=watch_5, amount=count_2, lacing=Shortest)
flatten_5 = List.Flatten(list=ofRepeatedItem_2)

code_block_6 = CodeBlock(i=flatten_5) { i / 1000; }
watch_6 = Watch(code_block_6)

# group: element-wm 별 적합 물량 매칭 구간 (unit:m2 base, unit:m modify)
watch_7 = Watch(flatten_2)
watch_8 = Watch(allIndicesOf)
getItemAtIndex = List.GetItemAtIndex(list=watch_6, index=allIndicesOf)
watch_9 = Watch(getItemAtIndex)
code_block_7 = CodeBlock(inList=watch_7, replaceIndex=watch_8, replaceValue=watch_9)
# ---------- code_block_7.designscript (6 lines) ----------
numIndex = 0..List.Count(inList)-1;
numIndexDiffer = List.SetDifference(numIndex,replaceIndex);
numIndexFlatten = List.Flatten([numIndexDiffer,replaceIndex],-1);
bln1 = List.Contains(replaceIndex,numIndex<1>);
outList = List.FilterByBoolMask(inList,bln1);
outListFlatten = List.Flatten([outList["out"],replaceValue],-1);
# ----------------------------------------
watch_10 = Watch(code_block_7.bln1)
watch_11 = Watch(code_block_7.outList)
sortByKey = List.SortByKey(list=code_block_7.outListFlatten, keys=code_block_7.numIndexFlatten)
watch_12 = Watch(sortByKey.sortedList)

# group: element 별 위치정보 삽입 구간
code_block_8 = CodeBlock {  }
code_block_9 = CodeBlock {  }

# group: wm 별 할증값 생성구간
code_block_10 = CodeBlock {  }
code_block_11 = CodeBlock {  }

# group: Excel Import
file_path = Filename("..\..\07_3D 기반 물량 집계 자동화\BIM_물량집계 자동화 산출기준표_rC(20210617)_mk.xlsx")
file_from_path = FileObject(path=file_path)
code_block_12 = CodeBlock { "Scope_lv2(Walls)"; }
code_block_13 = CodeBlock { false; }
importExcel = Data.ImportExcel(file=file_from_path, sheetName=code_block_12, showExcel=code_block_13)

# group: Null값 처리
code_block_14 = CodeBlock { " "; }
isNull = Object.IsNull()  # unwired: object
replaceByCondition = Replace(item=importExcel, replaceWith=code_block_14, condition=isNull)

# group: Whole Data(row direction)
watch_13 = Watch(replaceByCondition)

identity = Object.Identity(object=watch_13)
identity_2 = Object.Identity(object=identity)
code_block_15 = CodeBlock(i=identity_2) { i[3]; }
watch_14 = Watch(code_block_15)
rank = List.Rank(list=watch_4@L3)

# group: Whole Data(Column direction)
transpose = List.Transpose(lists=replaceByCondition)
watch_15 = Watch(transpose)

# group: Column Index Guide
code_block_16 = CodeBlock(i=watch_13) { i[3]; }
watch_16 = Watch(code_block_16)

# group: 모델링에 사용된 모든 패밀리타입 코드 추출
elementType_2 = Element.ElementType(element=groupByFunction)
name_2 = Element.Name(element=elementType_2)
uniqueItems_2 = List.UniqueItems(list=name_2@L2)
flatten_6 = List.Flatten(list=uniqueItems_2)
watch_17 = Watch(flatten_6)
code_block_17 = CodeBlock { "_"; }
split = String.Split(string=watch_17, separator0=code_block_17)
firstItem = List.FirstItem(list=split@L2)

# group: 사용된 패밀리타입이 위치한 Column Index 추출
string_from_object = FromObject(obj=watch_16)
contains = String.Contains(searchFor=firstItem, lacing=CrossProduct)  # unwired: string
map = List.Map(list=string_from_object, f_x=contains)
allFalse_2 = List.AllFalse(list=map@L2)
code_block_18 = CodeBlock(i=allFalse_2) { i==false?true:false; }
code_block_19 = CodeBlock { true; }
allIndicesOf_2 = List.AllIndicesOf(list=code_block_18, item=code_block_19)

# group: 사용된 패밀리타입 Column Data 추출
identity_3 = Object.Identity(object=allIndicesOf_2@L1)
getItemAtIndex_2 = List.GetItemAtIndex(list=watch_15, index=identity_3)
code_block_20 = CodeBlock { 4; ""; }
# note: 불필요 정보 처리
replaceItemAtIndex = List.ReplaceItemAtIndex(list=getItemAtIndex_2@L2, index=code_block_20.out0, item=code_block_20.out1)
watch_18 = Watch(getItemAtIndex_2)

watch_19 = Watch(replaceItemAtIndex)

# group: 사용된 패밀리 타입에서 세부코드가 기입된 Row 열 번호 추출
string_from_object_2 = FromObject(obj=replaceItemAtIndex)
code_block_21 = CodeBlock { "000"; }
contains_2 = String.Contains(string=string_from_object_2@L2, searchFor=code_block_21, lacing=CrossProduct)
code_block_22 = CodeBlock { true; }
allIndicesOf_3 = List.AllIndicesOf(list=contains_2@L2, item=code_block_22)
watch_20 = Watch(allIndicesOf_3)

getItemAtIndex_3 = List.GetItemAtIndex(list=identity_2, index=watch_20@L2)
watch_21 = Watch(getItemAtIndex_3)
code_block_23 = CodeBlock { 0; }
getItemAtIndex_4 = List.GetItemAtIndex(list=watch_21@@L2, index=code_block_23)
watch_22 = Watch(getItemAtIndex_4)
getItemAtIndex_5 = List.GetItemAtIndex(list=watch_19@L2, index=watch_20@L2)
watch_23 = Watch(getItemAtIndex_5)
code_block_24 = CodeBlock(i=watch_22, j=watch_23) { i + "-" + j; }

# group: Wall Type: WM Code 딕셔너리 생성(벽체 layer에 포함 되지 않은 WM code 까지 포함되어야함)
code_block_25 = CodeBlock { 3; }
getItemAtIndex_6 = List.GetItemAtIndex(list=watch_19@L2, index=code_block_25)
code_block_26 = CodeBlock { "_"; "-"; }
split_2 = String.Split(string=getItemAtIndex_6, separator0=code_block_26.out0, separator1=code_block_26.out1)
firstItem_2 = List.FirstItem(list=split_2@L2)
byKeysValues = DesignScript.Builtin.Dictionary.ByKeysValues(keys=firstItem_2, values=code_block_24)
watch_24 = Watch(byKeysValues)

watch_25 = Watch(firstItem)

# group: Family Type 별 sorting
elementType_3 = Element.ElementType()  # unwired: element
uniqueItems_3 = List.UniqueItems(list=elementType_3)
groupByFunction_3 = List.GroupByFunction(list=all_elements_of_category@L2, groupFunction=uniqueItems_3)

byKeysValues_2 = DesignScript.Builtin.Dictionary.ByKeysValues(keys=watch_25, values=groupByFunction_3@L3)
components = DesignScript.Builtin.Dictionary.Components(dictionary=byKeysValues_2)

# group: select all Category element by level
code_block_27 = CodeBlock { "Base Constraint"; }
getParameterValueByName_4 = Element.GetParameterValueByName(parameterName=code_block_27)  # unwired: element
groupByFunction_4 = List.GroupByFunction(list=components.values@L2, groupFunction=getParameterValueByName_4)

byKeysValues_3 = DesignScript.Builtin.Dictionary.ByKeysValues(keys=components.keys, values=components.values@L3)
count_3 = List.Count(list=ofRepeatedItem_2@L2)
sublists = List.Sublists(list=code_block_6, ranges=count_3)  # unwired: offset

# group: Row Index Guide
code_block_28 = CodeBlock(i=watch_15) { i[3]; }
watch_26 = Watch(code_block_28)

parameters = Element.Parameters(element=groupByFunction_2)
watch_27 = Watch(parameters)

# group: grid개체
categories_2 = Categories("OST_Grids")
all_elements_of_category_2 = ElementsOfCategory(Category=categories_2)
parameters_2 = Element.Parameters(element=all_elements_of_category_2)
name_3 = Element.Name(element=all_elements_of_category_2)
geometry = Element.Geometry(element=all_elements_of_category_2)

identity_4 = Object.Identity(object=groupByFunction_2)
identity_5 = Object.Identity(object=identity_4)
count_4 = List.Count(list=getMaterials@L2)
identity_6 = Object.Identity(object=count_4)

# group: input list 에서 대상문자열들 포함하는 index 추출(for forms)
대상_문자열_2 = CodeBlock()
# ---------- 대상_문자열_2.designscript (7 lines) ----------
[

"Form",
"Plastering"


];
# ----------------------------------------
code_block_29 = CodeBlock(str=flatten_3, searchFor=대상_문자열_2) { String.Contains(str<1>, searchFor, false); }
allFalse_3 = List.AllFalse(list=code_block_29@L2)
code_block_30 = CodeBlock { false; }
allIndicesOf_4 = List.AllIndicesOf(list=allFalse_3, item=code_block_30)

element_wm_별_면적_형상 = CodeBlock(i=flatten_2) { i; }

# group: element-wm 별 적합 물량 매칭 구간(벽체 양쪽 적용 WM Code modify)
watch_28 = Watch(watch_12)
watch_29 = Watch(allIndicesOf_4)
getItemAtIndex_7 = List.GetItemAtIndex(list=element_wm_별_면적_형상, index=allIndicesOf_4)

form_물량_보정 = CodeBlock(i=getItemAtIndex_7) { i * 2; }

# group (continued): element-wm 별 적합 물량 매칭 구간(벽체 양쪽 적용 WM Code modify)
watch_30 = Watch(form_물량_보정)
code_block_31 = CodeBlock(inList=watch_28, replaceIndex=watch_29, replaceValue=watch_30)  # same code as code_block_7
sortByKey_2 = List.SortByKey(list=code_block_31.outListFlatten, keys=code_block_31.numIndexFlatten)
watch_31 = Watch(sortByKey_2.sortedList)

# group: element 별 Family Type 삽입 구간
identity_7 = Object.Identity(object=identity_5)
elementType_4 = Element.ElementType(element=identity_7@L1)
name_4 = Element.Name(element=elementType_4)
ofRepeatedItem_3 = List.OfRepeatedItem(item=name_4, amount=identity_6, lacing=Shortest)
watch_32 = Watch(watch_31)

watch_33 = Watch(ofRepeatedItem_3)

# group (continued): element 별 Family Type 삽입 구간
code_block_32 = CodeBlock(i=watch_33, j=watch_32) { i + "..." + j; }

identity_8 = Object.Identity(object=flatten_3)
identity_9 = Object.Identity(object=identity_8)

# group: element 별 WM code 삽입 구간
watch_34 = Watch(code_block_32)
watch_35 = Watch(identity_9)
code_block_33 = CodeBlock(i=watch_34, j=watch_35) { i + "..." + j; }
watch_36 = Watch(code_block_33)

# group: Data arrange for excel
flatten_7 = List.Flatten(list=watch_36)
code_block_34 = CodeBlock { "..."; }
split_3 = String.Split(string=flatten_7, separator0=code_block_34)
watch_37 = Watch(split_3)

# group: Excel Export
file_path_2 = Filename("C:\Users\HEC\Desktop\Wall Calculation sheet.xlsx")
code_block_35 = CodeBlock { "Wall Calculation"; }
code_block_36 = CodeBlock { 0; }
boolean = BoolSelector(true)
exportExcel = Data.ExportExcel(filePath=file_path_2, sheetName=code_block_35, startRow=code_block_36, startColumn=code_block_36, data=watch_37, overWrite=boolean)  # frozen

# group: Primary Input : Excel & Revit Elements
categories_3 = Categories("OST_Walls")
all_elements_of_category_3 = ElementsOfCategory(Category=categories_3)
string_from_web = Python()  # CPython3; unwired: IN[0]
# ---------- string_from_web.python (19 lines) ----------
# Load the Python Standard and DesignScript Libraries
import sys
import clr
clr.AddReference('ProtoGeometry')
from Autodesk.DesignScript.Geometry import *
import urllib.request

# The inputs to this node will be stored as a list in the IN variables.
dataEnteringNode = IN
inputURL = "https://raw.githubusercontent.com/HNANmal/mQ/master/Hdynlib/General/ImportExcel.py"

# Place your code below this line
req = urllib.request
data = req.urlopen(inputURL)

result = data.read().decode("utf-8")

# Assign your output to the OUT variable.
OUT = result
# ----------------------------------------
file_path_3 = Filename(".\BIM_물량집계 자동화 산출기준표_rC(20211207)_강한호 (1).xlsx")  # graph input
sheet_name = CodeBlock { "Walls"; }
github_python_import_excel_by = PythonStringNode(script=string_from_web, IN[0]=file_path_3, IN[1]=sheet_name)  # "Github_Python@Import Excel(By OpenpyXl)"; CPython3
code_block_37 = CodeBlock(InputElement=all_elements_of_category_3, InputData=github_python_import_excel_by) { _InputElement; _InputData; }

# group: GetFull WMCodeDescription PerElement
excelDataManagerNode = Python(IN[0]=code_block_37._InputElement, IN[1]=code_block_37._InputData)  # CPython3
# ---------- excelDataManagerNode.python (279 lines) ----------
# Load the Python Standard and DesignScript Libraries
import os
import sys
sys.path.append(os.getenv('LOCALAPPDATA').replace('\\','\\\\') + r'\Programs\Python\Python39\Lib\site-packages')
import clr
clr.AddReference('RevitAPI')
import Autodesk

clr.AddReference('ProtoGeometry')
from Autodesk.DesignScript.Geometry import *

clr.AddReference('RevitNodes')
import Revit
clr.ImportExtensions(Revit.Elements)

clr.ImportExtensions(Revit.GeometryConversion)
clr.ImportExtensions(Revit.GeometryReferences)

clr.AddReference('RevitServices')
import RevitServices
from RevitServices.Persistence import DocumentManager
from RevitServices.Transactions import TransactionManager

doc = DocumentManager.Instance.CurrentDBDocument

import random
import itertools
from functools import reduce
from collections import Iterable
import datetime
import openpyxl

def iterable(obj):
    return isinstance(obj, Iterable)

def findUnique(inputs):
    result = []
    for i in inputs:
        if i in result:
            pass
        else:
            result.append(i)
    return result

# The inputs to this node will be stored as a list in the IN variables.
dataEnteringNode = IN
inputElements = IN[0]
inputData = IN[1]
#inputSheetName = IN[2]

def importExcel(path, SheetNameIn):
    wb_obj = openpyxl.load_workbook(str(path), data_only=True)
    sheet_obj = wb_obj.get_sheet_by_name(str(SheetNameIn))

    m_row = sheet_obj.max_row
    m_col = sheet_obj.max_column

    listOut = []

    for i in range(1, m_row +1):
        listTemp = []
        for j in range(1, m_col + 1):
            cell_obj = sheet_obj.cell(row=i, column=j)
            listTemp.append(cell_obj.value)
            if len(listTemp) == m_col:
                listOut.append(listTemp)
    return listOut

def getUsedFamilyTypeOfModeling(elements):
    familyCode = list(map(lambda x: x.Name.split('_')[0], elements))
    unq_familyCode = findUnique(familyCode)
    return unq_familyCode
    
def createExcelDataDictionary(values):
    result = {}
    for i in range(len(values)):
        result[str(i)] = values[i]
    return result

def findTargetIndex(targets, list):
    result = []
    for target in targets:
        for i in range(len(list)):
            if target in str(list[i]):
                result.append(i)
            else:
                pass
    result.sort()
    return result
    
def GetValueAtKeys(keys, dictionary):
    result = [] 
    for i in keys:
        result.append(dictionary[str(i)])
    return result


# Place your code below this line
usedFamilyTypeOfModeling = getUsedFamilyTypeOfModeling(inputElements)
excelWholeDataSet = inputData#importExcel(inputFilePath, inputSheetName)
trExcelWholeDataSet = list(zip(*excelWholeDataSet))
excelColumnDataSet = createExcelDataDictionary(trExcelWholeDataSet)
excelRowDataSet = createExcelDataDictionary(excelWholeDataSet)
ColumnIndexOfUsedFamilyType = findTargetIndex(usedFamilyTypeOfModeling, trExcelWholeDataSet)
ColDataSetOfUsedFamilyType = GetValueAtKeys(ColumnIndexOfUsedFamilyType, excelColumnDataSet)
materialPerElementFromModeling = []
for i in inputElements:
    materialPerElementFromModeling.append(i.GetMaterials())
#list(map(lambda x: x.GetMaterials, inputElements)) "맵함수로 처리하면 리스트화 할 때 타입 변환 오류 남"

targetWMRowIndex = []
for i in ColDataSetOfUsedFamilyType:
    targetWMRowIndex.append(findTargetIndex(['000'], i))

rowDataSetOfUsedWM = []
for i in targetWMRowIndex:
    rowDataSetOfUsedWM.append(GetValueAtKeys(i, excelRowDataSet))

workGroup = []
for i in rowDataSetOfUsedWM:
    tmp = []
    for j in i:
        tmp.append(j[0])
    workGroup.append(tmp)
    
workMaster = []
for i in range(len(ColDataSetOfUsedFamilyType)):
    tmp=[]
    for k in targetWMRowIndex[i]:
        tmp.append(ColDataSetOfUsedFamilyType[i][k])
    workMaster.append(tmp)

matchedWM = []
for i in range(len(workGroup)):
    tmp = []
    for j in range(len(workGroup[i])):
        fullWM = workGroup[i][j] +"-"+ workMaster[i][j]
        tmp.append(fullWM)
    matchedWM.append(tmp)

matchedWorkGruopAndMasterCode = []
for i in matchedWM:
    if len(i) > 0:
        matchedWorkGruopAndMasterCode.append(i)
    else:
        pass

matchedWMDescription = []
for i in rowDataSetOfUsedWM:
    tmp=[]
    for j in i:
        tmp.append(j[1] +" "+ j[2] +" "+ j[3] +" "+ "("+ j[4] +")")
    if len(tmp) > 0:
        matchedWMDescription.append(tmp)
    else:
        pass

matchedWMUnit = []
for i in rowDataSetOfUsedWM:
    tmp=[]
    for j in i:
        tmp.append(j[4])
    if len(tmp) > 0:
        matchedWMUnit.append(tmp)
    else:
        pass

matchedWorkGruopAndMasterCode_flat = list(itertools.chain(*matchedWorkGruopAndMasterCode))
matchedWMDescription_flat = list(itertools.chain(*matchedWMDescription))

dic_WMandDescription_Excel = {}
for i in range(len(matchedWorkGruopAndMasterCode_flat)):
    dic_WMandDescription_Excel[matchedWorkGruopAndMasterCode_flat[i]] = matchedWMDescription_flat[i]

usedFamilyTypeInExcelOrder = list(map(lambda x: x[3], ColDataSetOfUsedFamilyType))
usedFamilyCodeInExcelOrder = findUnique(list(map(lambda x: x.split('_')[0], usedFamilyTypeInExcelOrder)))

dic_FamilyCodeandWM = {}
for i in range(len(usedFamilyCodeInExcelOrder)):
    dic_FamilyCodeandWM[usedFamilyCodeInExcelOrder[i]] = matchedWorkGruopAndMasterCode[i]

workMasterCodePerElement = []
familyCodePerElem = list(map(lambda x: x.Name.split('_')[0], inputElements))
for i in familyCodePerElem:
    workMasterCodePerElement.append(dic_FamilyCodeandWM[i])

materialNamePerElem = []
for i in materialPerElementFromModeling:
    tmp = []
    for j in i:
        tmp.append(j.Name)
    materialNamePerElem.append(tmp)

WMPerElementFromModeling = []
for i in materialNamePerElem:
    tmp = []
    for j in i:
        tmp.append(j.split('_')[0])
    WMPerElementFromModeling.append(tmp)

specPerElementFromModeling = []
for i in materialNamePerElem:
    tmp = []
    for j in i:
        a = j.split('_')
        del a[0]
        b = " ".join(a)
        tmp.append(b)
    specPerElementFromModeling.append(tmp)

WMPerElementFromModeling_flat = list(itertools.chain(*WMPerElementFromModeling))
specPerElementFromModeling_flat = list(itertools.chain(*specPerElementFromModeling))

dic_WMandDescription_Model = {}
for i in range(len(WMPerElementFromModeling_flat)):
    dic_WMandDescription_Model[WMPerElementFromModeling_flat[i]] = specPerElementFromModeling_flat[i]

def findAllKeys(dict):
    result = []
    for key in dict.keys():
        result.append(key)
    return result

def findAllValues(dict):
    result = []
    for key in dict.keys():
        result.append(dict[key])
    return result

keys_WMandDescription_Model = findAllKeys(dic_WMandDescription_Model)
keys_WMandDescription_Excel = findAllKeys(dic_WMandDescription_Excel)

keys_WMandDescription_Both = list(set(keys_WMandDescription_Model + keys_WMandDescription_Excel))
values_WMandDescription_Both = []
for i in keys_WMandDescription_Both:
    if i in keys_WMandDescription_Model:
        values_WMandDescription_Both.append(dic_WMandDescription_Model[i])
    else:
        values_WMandDescription_Both.append(dic_WMandDescription_Excel[i])

dic_WMandDescription_Both = {}
for i in range(len(keys_WMandDescription_Both)):
    dic_WMandDescription_Both[keys_WMandDescription_Both[i]] = values_WMandDescription_Both[i]

workMasterCodePerElementFromBoth = []
for i in range(len(workMasterCodePerElement)):
    #tmp = []
    a = WMPerElementFromModeling[i] + workMasterCodePerElement[i]
    b = findUnique(a)
    workMasterCodePerElementFromBoth.append(b)

specPerElement = []
for i in workMasterCodePerElementFromBoth:
    tmp = []
    for j in i:
        tmp.append(dic_WMandDescription_Both[j])
    specPerElement.append(tmp)

fullWMCodeDescriptionPerElement = []
for i in range(len(workMasterCodePerElementFromBoth)):
    tmp = []
    for j in range(len(workMasterCodePerElementFromBoth[i])):
        a = workMasterCodePerElementFromBoth[i][j] +": "+ specPerElement[i][j]
        tmp.append(a)
    fullWMCodeDescriptionPerElement.append(tmp)

fullWMinfo = {
"AllElement": inputElements,
"WorkMasterCodePerFamilyType": dic_FamilyCodeandWM,
"WorkMasterCodePerElementBoth": workMasterCodePerElementFromBoth,
"FullWMCodeDescriptionPerElement": fullWMCodeDescriptionPerElement
}



result = fullWMinfo

# Assign your output to the OUT variable.
OUT = result
# ----------------------------------------

# group: Organize AllElementInform AsDictionary
set_up_all_element_inform_as = Python(IN[0]=excelDataManagerNode)  # "Set Up All Element Inform as Dictionary"; CPython3
# ---------- set_up_all_element_inform_as.python (119 lines) ----------
# Load the Python Standard and DesignScript Libraries
import os
import sys
sys.path.append(os.getenv('LOCALAPPDATA').replace('\\','\\\\') + r'\Programs\Python\Python39\Lib\site-packages')
import clr
clr.AddReference('RevitAPI')
import Autodesk

clr.AddReference('ProtoGeometry')
from Autodesk.DesignScript.Geometry import *

clr.AddReference('RevitNodes')
import Revit
clr.ImportExtensions(Revit.Elements)

clr.ImportExtensions(Revit.GeometryConversion)
clr.ImportExtensions(Revit.GeometryReferences)

clr.AddReference('RevitServices')
import RevitServices
from RevitServices.Persistence import DocumentManager
from RevitServices.Transactions import TransactionManager

doc = DocumentManager.Instance.CurrentDBDocument

import random
import itertools
from functools import reduce
from collections import Iterable
import datetime
import openpyxl

def iterable(obj):
    return isinstance(obj, Iterable)

def findUnique(inputs):
    result = []
    for i in inputs:
        if i in result:
            pass
        else:
            result.append(i)
    return result

# The inputs to this node will be stored as a list in the IN variables.
dataEnteringNode = IN
inputDict = IN[0]


def importExcel(path, SheetNameIn):
    wb_obj = openpyxl.load_workbook(str(path), data_only=True)
    sheet_obj = wb_obj.get_sheet_by_name(str(SheetNameIn))

    m_row = sheet_obj.max_row
    m_col = sheet_obj.max_column

    listOut = []

    for i in range(1, m_row +1):
        listTemp = []
        for j in range(1, m_col + 1):
            cell_obj = sheet_obj.cell(row=i, column=j)
            listTemp.append(cell_obj.value)
            if len(listTemp) == m_col:
                listOut.append(listTemp)
    return listOut

def getUsedFamilyTypeOfModeling(elements):
    familyCode = list(map(lambda x: x.Name.split('_')[0], elements))
    unq_familyCode = findUnique(familyCode)
    return unq_familyCode
    
def createExcelDataDictionary(values):
    result = {}
    for i in range(len(values)):
        result[str(i)] = values[i]
    return result

def findTargetIndex(targets, list):
    result = []
    for target in targets:
        for i in range(len(list)):
            if target in str(list[i]):
                result.append(i)
            else:
                pass
    result.sort()
    return result
    
def GetValueAtKeys(keys, dictionary):
    result = [] 
    for i in keys:
        result.append(dictionary[str(i)])
    return result


# Place your code below this line
element = inputDict["AllElement"]
elementType = []
for i in element:
    elementType.append(i.Name)
familyCode = []
for i in elementType:
    familyCode.append(i.split("_")[0])
fullWMCodeDescriptionPerElement = inputDict["FullWMCodeDescriptionPerElement"]

resultDict = {
"Element": element,
"ElementType": elementType,
"FamilyCode": familyCode,
"FullWMCodeDescriptionPerElement": fullWMCodeDescriptionPerElement
}



result = resultDict

# Assign your output to the OUT variable.
OUT = result
# ----------------------------------------

# group: Select Target Family Element And Connected WorkMasters
code_block_38 = CodeBlock { 0; }
select_target_family_element_and = Python(IN[0]=set_up_all_element_inform_as, IN[1]=code_block_38)  # "Select Target Family Element And Connected WorkMasters"; CPython3
# ---------- select_target_family_element_and.python (138 lines) ----------
# Load the Python Standard and DesignScript Libraries
import os
import sys
sys.path.append(os.getenv('LOCALAPPDATA').replace('\\','\\\\') + r'\Programs\Python\Python39\Lib\site-packages')
import clr
clr.AddReference('RevitAPI')
import Autodesk

clr.AddReference('ProtoGeometry')
from Autodesk.DesignScript.Geometry import *

clr.AddReference('RevitNodes')
import Revit
clr.ImportExtensions(Revit.Elements)

clr.ImportExtensions(Revit.GeometryConversion)
clr.ImportExtensions(Revit.GeometryReferences)

clr.AddReference('RevitServices')
import RevitServices
from RevitServices.Persistence import DocumentManager
from RevitServices.Transactions import TransactionManager

doc = DocumentManager.Instance.CurrentDBDocument

import random
import itertools
from functools import reduce
from collections import Iterable
import datetime
import openpyxl

def iterable(obj):
    return isinstance(obj, Iterable)

def findUnique(inputs):
    result = []
    for i in inputs:
        if i in result:
            pass
        else:
            result.append(i)
    return result

# The inputs to this node will be stored as a list in the IN variables.
dataEnteringNode = IN
inputDict = IN[0]
inputIndex = IN[1]


def importExcel(path, SheetNameIn):
    wb_obj = openpyxl.load_workbook(str(path), data_only=True)
    sheet_obj = wb_obj.get_sheet_by_name(str(SheetNameIn))

    m_row = sheet_obj.max_row
    m_col = sheet_obj.max_column

    listOut = []

    for i in range(1, m_row +1):
        listTemp = []
        for j in range(1, m_col + 1):
            cell_obj = sheet_obj.cell(row=i, column=j)
            listTemp.append(cell_obj.value)
            if len(listTemp) == m_col:
                listOut.append(listTemp)
    return listOut

def getUsedFamilyTypeOfModeling(elements):
    familyCode = list(map(lambda x: x.Name.split('_')[0], elements))
    unq_familyCode = findUnique(familyCode)
    return unq_familyCode
    
def createExcelDataDictionary(values):
    result = {}
    for i in range(len(values)):
        result[str(i)] = values[i]
    return result

def findTargetIndex(targets, list):
    result = []
    for target in targets:
        for i in range(len(list)):
            if target in str(list[i]):
                result.append(i)
            else:
                pass
    result.sort()
    return result
    
def GetValueAtKeys(keys, dictionary):
    result = [] 
    for i in keys:
        result.append(dictionary[str(i)])
    return result


# Place your code below this line
fullWMCodeDescriptionPerElement = inputDict["FullWMCodeDescriptionPerElement"]
element = inputDict["Element"]
familyCode = inputDict["FamilyCode"]
familyCode_unique = findUnique(familyCode)
targetFamilyCode = familyCode_unique[inputIndex]
targetIndex = []
for i in range(len(familyCode)):
    if targetFamilyCode in familyCode[i]:
        targetIndex.append(i)
    else:
        pass

targetElements = []
for i in targetIndex:
    targetElements.append(element[i])

targetFamilyCode = []
for i in targetIndex:
    targetFamilyCode.append(element[i].Name)

WMforTargetElements = []
for i in targetIndex:
    WMforTargetElements.append(fullWMCodeDescriptionPerElement[i])

WMforTargetElements_flat = list(itertools.chain(*WMforTargetElements))
targetWMunique = findUnique(WMforTargetElements_flat)

resultDict = {
"TargetElements": targetElements,
"TargetFamilyCode": targetFamilyCode,
"WMforTargetElements": WMforTargetElements,
"TargetWMunique": targetWMunique
}



result = resultDict

# Assign your output to the OUT variable.
OUT = result
# ----------------------------------------

watch_38 = Watch(select_target_family_element_and)

# group: Select Target Family Element And Connected WorkMasters
code_block_39 = CodeBlock { 1; }
select_target_family_element_and_2 = Python(IN[0]=set_up_all_element_inform_as, IN[1]=code_block_39)  # "Select Target Family Element And Connected WorkMasters"; CPython3; same code as select_target_family_element_and

watch_39 = Watch(select_target_family_element_and_2)

# group: Select Target Family Element And Connected WorkMasters
code_block_40 = CodeBlock { 2; }
select_target_family_element_and_3 = Python(IN[0]=set_up_all_element_inform_as, IN[1]=code_block_40)  # "Select Target Family Element And Connected WorkMasters"; CPython3; same code as select_target_family_element_and

watch_40 = Watch(select_target_family_element_and_3)

# group: Select Target Family Element And Connected WorkMasters
code_block_41 = CodeBlock { 3; }
select_target_family_element_and_4 = Python(IN[0]=set_up_all_element_inform_as, IN[1]=code_block_41)  # "Select Target Family Element And Connected WorkMasters"; CPython3; same code as select_target_family_element_and

watch_41 = Watch(select_target_family_element_and_4)

# group: Select Target Family Element And Connected WorkMasters
code_block_42 = CodeBlock { 4; }
select_target_family_element_and_5 = Python(IN[0]=set_up_all_element_inform_as, IN[1]=code_block_42)  # "Select Target Family Element And Connected WorkMasters"; CPython3; same code as select_target_family_element_and

watch_42 = Watch(select_target_family_element_and_5)
code_block_43 = CodeBlock { i; }  # unwired: i

# group: Input Manager
value_for_import_from_others = CodeBlock(MainInput=code_block_43) { MainInput; RefInput1; RefInput2; }  # unwired: RefInput1, RefInput2

# group: <Func 1> Structural Concrete
code_block_44 = CodeBlock { "TargetElements"; }
valueAtKey = DesignScript.Builtin.Dictionary.ValueAtKey(dictionary=value_for_import_from_others.MainInput, key=code_block_44)
# note: <Func>
geometry_2 = Element.Geometry(element=valueAtKey)
volume = Solid.Volume(solid=geometry_2)
code_block_45 = CodeBlock(i=volume) { Math.Round(List.Flatten(i)/1000000000,2); }
code_block_46 = CodeBlock { "M3"; }
count_5 = List.Count(list=code_block_45)
ofRepeatedItem_4 = List.OfRepeatedItem(item=code_block_46, amount=count_5)
code_block_47 = CodeBlock(FuncValues=code_block_45, FuncValuesUnit=ofRepeatedItem_4)
# ---------- code_block_47.designscript (4 lines) ----------
{
"FuncValues": _FuncValues,
"FuncValuesUnit": _FuncValuesUnit
};
# ----------------------------------------

# group: Output Manager
output = CodeBlock(MainOutput=code_block_47) { MainOutput; RefOutput_geoColor; }  # unwired: RefOutput_geoColor
reference_output = CodeBlock(ref=geometry_2) { ref; }

# group: Input Manager
value_for_import_from_others_2 = CodeBlock(MainInput=code_block_43) { MainInput; RefInput1; RefInput2; }  # unwired: RefInput1, RefInput2

# group: <Func 2> Superstructure Structural Form Works
code_block_48 = CodeBlock { "TargetElements"; }
valueAtKey_2 = DesignScript.Builtin.Dictionary.ValueAtKey(dictionary=value_for_import_from_others_2.MainInput, key=code_block_48)
code_block_49 = CodeBlock { "Volume"; }
# note: <Func>
getParameterValueByName_5 = Element.GetParameterValueByName(element=valueAtKey_2, parameterName=code_block_49)
code_block_50 = CodeBlock(i=getParameterValueByName_5) { Math.Round(List.Flatten(i)/10000000,2); }
code_block_51 = CodeBlock { "M3"; }
count_6 = List.Count(list=code_block_50)
ofRepeatedItem_5 = List.OfRepeatedItem(item=code_block_51, amount=count_6)
code_block_52 = CodeBlock(FuncValues=code_block_50, FuncValuesUnit=ofRepeatedItem_5)  # same code as code_block_47

# group: Output Manager
output_2 = CodeBlock(MainOutput=code_block_52) { MainOutput; RefOutput_geoColor; }  # unwired: RefOutput_geoColor
reference_output_2 = CodeBlock { ref; }  # unwired: ref

# group: Output Manager
output_3 = CodeBlock { MainOutput; RefOutput_geoColor; }  # unwired: MainOutput, RefOutput_geoColor
reference_output_3 = CodeBlock { ref; }  # unwired: ref

# group: Input Manager
value_for_import_from_others_3 = CodeBlock(MainInput=code_block_43) { MainInput; RefInput1; RefInput2; }  # unwired: RefInput1, RefInput2

# group: <Func 3> Superstructure Structrual Rebar Work
code_block_53 = CodeBlock { "TargetElements"; }
# note: <Func>
valueAtKey_3 = DesignScript.Builtin.Dictionary.ValueAtKey(dictionary=value_for_import_from_others_3.MainInput, key=code_block_53)

# group: Output Manager
output_4 = CodeBlock { MainOutput; RefOutput_geoColor; }  # unwired: MainOutput, RefOutput_geoColor
reference_output_4 = CodeBlock { ref; }  # unwired: ref

code_block_54 = CodeBlock(i=select_target_family_element_and_2) { i; }

# group: Input Manager
value_for_import_from_others_4 = CodeBlock(MainInput=code_block_54) { MainInput; RefInput1; RefInput2; }  # unwired: RefInput1, RefInput2

# group: <Func 0> M2
code_block_55 = CodeBlock { "TargetElements"; }
# note: <Func>
valueAtKey_4 = DesignScript.Builtin.Dictionary.ValueAtKey(dictionary=value_for_import_from_others_4.MainInput, key=code_block_55)

# group: Output Manager
output_5 = CodeBlock { MainOutput; RefOutput_geoColor; }  # unwired: MainOutput, RefOutput_geoColor
reference_output_5 = CodeBlock { ref; }  # unwired: ref

# group: Input Manager
value_for_import_from_others_5 = CodeBlock(MainInput=code_block_54) { MainInput; RefInput1; RefInput2; }  # unwired: RefInput1, RefInput2

# group: <Func 0> M2
code_block_56 = CodeBlock { "TargetElements"; }
# note: <Func>
valueAtKey_5 = DesignScript.Builtin.Dictionary.ValueAtKey(dictionary=value_for_import_from_others_5.MainInput, key=code_block_56)

# group: Output Manager
output_6 = CodeBlock { MainOutput; RefOutput_geoColor; }  # unwired: MainOutput, RefOutput_geoColor
reference_output_6 = CodeBlock { ref; }  # unwired: ref

# group: Input Manager
value_for_import_from_others_6 = CodeBlock(MainInput=code_block_54) { MainInput; RefInput1; RefInput2; }  # unwired: RefInput1, RefInput2

# group: <Func 0> M2
code_block_57 = CodeBlock { "TargetElements"; }
# note: <Func>
valueAtKey_6 = DesignScript.Builtin.Dictionary.ValueAtKey(dictionary=value_for_import_from_others_6.MainInput, key=code_block_57)

# group: Output Manager
output_7 = CodeBlock { MainOutput; RefOutput_geoColor; }  # unwired: MainOutput, RefOutput_geoColor
reference_output_7 = CodeBlock { ref; }  # unwired: ref

# group: Input Manager
value_for_import_from_others_7 = CodeBlock(MainInput=code_block_54) { MainInput; RefInput1; RefInput2; }  # unwired: RefInput1, RefInput2

# group: <Func 0> M2
code_block_58 = CodeBlock { "TargetElements"; }
# note: <Func>
valueAtKey_7 = DesignScript.Builtin.Dictionary.ValueAtKey(dictionary=value_for_import_from_others_7.MainInput, key=code_block_58)

# group: Output Manager
output_8 = CodeBlock { MainOutput; RefOutput_geoColor; }  # unwired: MainOutput, RefOutput_geoColor
reference_output_8 = CodeBlock { ref; }  # unwired: ref

# group: Input Manager
value_for_import_from_others_8 = CodeBlock(MainInput=code_block_54) { MainInput; RefInput1; RefInput2; }  # unwired: RefInput1, RefInput2

# group: <Func 0> M2
code_block_59 = CodeBlock { "TargetElements"; }
# note: <Func>
valueAtKey_8 = DesignScript.Builtin.Dictionary.ValueAtKey(dictionary=value_for_import_from_others_8.MainInput, key=code_block_59)

# group: Output Manager
output_9 = CodeBlock { MainOutput; RefOutput_geoColor; }  # unwired: MainOutput, RefOutput_geoColor
reference_output_9 = CodeBlock { ref; }  # unwired: ref

# group: Input Manager
value_for_import_from_others_9 = CodeBlock(MainInput=code_block_54) { MainInput; RefInput1; RefInput2; }  # unwired: RefInput1, RefInput2

# group: <Func 0> M2
code_block_60 = CodeBlock { "TargetElements"; }
# note: <Func>
valueAtKey_9 = DesignScript.Builtin.Dictionary.ValueAtKey(dictionary=value_for_import_from_others_9.MainInput, key=code_block_60)

# group: Output Manager
reference_output_10 = CodeBlock { ref; }  # unwired: ref
output_10 = CodeBlock { MainOutput; RefOutput_geoColor; }  # unwired: MainOutput, RefOutput_geoColor

# group: Input Manager
value_for_import_from_others_10 = CodeBlock(MainInput=code_block_54) { MainInput; RefInput1; RefInput2; }  # unwired: RefInput1, RefInput2

# group: <Func 0> M2
code_block_61 = CodeBlock { "TargetElements"; }
# note: <Func>
valueAtKey_10 = DesignScript.Builtin.Dictionary.ValueAtKey(dictionary=value_for_import_from_others_10.MainInput, key=code_block_61)

# group: Output Manager
output_11 = CodeBlock { MainOutput; RefOutput_geoColor; }  # unwired: MainOutput, RefOutput_geoColor
reference_output_11 = CodeBlock { ref; }  # unwired: ref

# group: Input Manager
value_for_import_from_others_11 = CodeBlock(MainInput=code_block_54) { MainInput; RefInput1; RefInput2; }  # unwired: RefInput1, RefInput2

# group: <Func 0> M2
code_block_62 = CodeBlock { "TargetElements"; }
# note: <Func>
valueAtKey_11 = DesignScript.Builtin.Dictionary.ValueAtKey(dictionary=value_for_import_from_others_11.MainInput, key=code_block_62)

# group: Output Manager
output_12 = CodeBlock { MainOutput; RefOutput_geoColor; }  # unwired: MainOutput, RefOutput_geoColor
reference_output_12 = CodeBlock { ref; }  # unwired: ref

code_block_63 = CodeBlock(i=select_target_family_element_and_3) { i; }

# group: Input Manager
value_for_import_from_others_12 = CodeBlock(MainInput=code_block_63) { MainInput; RefInput1; RefInput2; }  # unwired: RefInput1, RefInput2

# group: <Func 0> M2
code_block_64 = CodeBlock { "TargetElements"; }
# note: <Func>
valueAtKey_12 = DesignScript.Builtin.Dictionary.ValueAtKey(dictionary=value_for_import_from_others_12.MainInput, key=code_block_64)

# group: Input Manager
value_for_import_from_others_13 = CodeBlock(MainInput=code_block_63) { MainInput; RefInput1; RefInput2; }  # unwired: RefInput1, RefInput2

# group: <Func 0> M2
code_block_65 = CodeBlock { "TargetElements"; }
# note: <Func>
valueAtKey_13 = DesignScript.Builtin.Dictionary.ValueAtKey(dictionary=value_for_import_from_others_13.MainInput, key=code_block_65)

# group: Output Manager
output_13 = CodeBlock { MainOutput; RefOutput_geoColor; }  # unwired: MainOutput, RefOutput_geoColor
reference_output_13 = CodeBlock { ref; }  # unwired: ref

# group: Input Manager
value_for_import_from_others_14 = CodeBlock(MainInput=code_block_63) { MainInput; RefInput1; RefInput2; }  # unwired: RefInput1, RefInput2

# group: <Func 0> M2
code_block_66 = CodeBlock { "TargetElements"; }
# note: <Func>
valueAtKey_14 = DesignScript.Builtin.Dictionary.ValueAtKey(dictionary=value_for_import_from_others_14.MainInput, key=code_block_66)

# group: Output Manager
output_14 = CodeBlock { MainOutput; RefOutput_geoColor; }  # unwired: MainOutput, RefOutput_geoColor
reference_output_14 = CodeBlock { ref; }  # unwired: ref

# group: Input Manager
value_for_import_from_others_15 = CodeBlock(MainInput=code_block_63) { MainInput; RefInput1; RefInput2; }  # unwired: RefInput1, RefInput2

# group: <Func 0> M2
code_block_67 = CodeBlock { "TargetElements"; }
# note: <Func>
valueAtKey_15 = DesignScript.Builtin.Dictionary.ValueAtKey(dictionary=value_for_import_from_others_15.MainInput, key=code_block_67)

# group: Output Manager
reference_output_15 = CodeBlock { ref; }  # unwired: ref
output_15 = CodeBlock { MainOutput; RefOutput_geoColor; }  # unwired: MainOutput, RefOutput_geoColor

# group: Input Manager
value_for_import_from_others_16 = CodeBlock(MainInput=code_block_63) { MainInput; RefInput1; RefInput2; }  # unwired: RefInput1, RefInput2

# group: <Func 0> M2
code_block_68 = CodeBlock { "TargetElements"; }
# note: <Func>
valueAtKey_16 = DesignScript.Builtin.Dictionary.ValueAtKey(dictionary=value_for_import_from_others_16.MainInput, key=code_block_68)

# group: Output Manager
output_16 = CodeBlock { MainOutput; RefOutput_geoColor; }  # unwired: MainOutput, RefOutput_geoColor
reference_output_16 = CodeBlock { ref; }  # unwired: ref

# group: Output Manager
output_17 = CodeBlock { MainOutput; RefOutput_geoColor; }  # unwired: MainOutput, RefOutput_geoColor
reference_output_17 = CodeBlock { ref; }  # unwired: ref

# group: Output Manager
output_18 = CodeBlock { MainOutput; RefOutput_geoColor; }  # unwired: MainOutput, RefOutput_geoColor
reference_output_18 = CodeBlock { ref; }  # unwired: ref

# group: Output Manager
output_19 = CodeBlock { MainOutput; RefOutput_geoColor; }  # unwired: MainOutput, RefOutput_geoColor
reference_output_19 = CodeBlock { ref; }  # unwired: ref

# group: Output Manager
output_20 = CodeBlock { MainOutput; RefOutput_geoColor; }  # unwired: MainOutput, RefOutput_geoColor
reference_output_20 = CodeBlock { ref; }  # unwired: ref

code_block_69 = CodeBlock(i=select_target_family_element_and_4) { i; }

# group: Input Manager
value_for_import_from_others_17 = CodeBlock(MainInput=code_block_69) { MainInput; RefInput1; RefInput2; }  # unwired: RefInput1, RefInput2

# group: <Func 0> M2
code_block_70 = CodeBlock { "TargetElements"; }
# note: <Func>
valueAtKey_17 = DesignScript.Builtin.Dictionary.ValueAtKey(dictionary=value_for_import_from_others_17.MainInput, key=code_block_70)

# group: Input Manager
value_for_import_from_others_18 = CodeBlock(MainInput=code_block_69) { MainInput; RefInput1; RefInput2; }  # unwired: RefInput1, RefInput2

# group: <Func 0> M2
code_block_71 = CodeBlock { "TargetElements"; }
# note: <Func>
valueAtKey_18 = DesignScript.Builtin.Dictionary.ValueAtKey(dictionary=value_for_import_from_others_18.MainInput, key=code_block_71)

# group: Input Manager
value_for_import_from_others_19 = CodeBlock(MainInput=code_block_69) { MainInput; RefInput1; RefInput2; }  # unwired: RefInput1, RefInput2

# group: <Func 0> M2
code_block_72 = CodeBlock { "TargetElements"; }
# note: <Func>
valueAtKey_19 = DesignScript.Builtin.Dictionary.ValueAtKey(dictionary=value_for_import_from_others_19.MainInput, key=code_block_72)

# group: Input Manager
value_for_import_from_others_20 = CodeBlock(MainInput=code_block_69) { MainInput; RefInput1; RefInput2; }  # unwired: RefInput1, RefInput2

# group: <Func 0> M2
code_block_73 = CodeBlock { "TargetElements"; }
# note: <Func>
valueAtKey_20 = DesignScript.Builtin.Dictionary.ValueAtKey(dictionary=value_for_import_from_others_20.MainInput, key=code_block_73)

# group: Input Manager
value_for_import_from_others_21 = CodeBlock(MainInput=code_block_69) { MainInput; RefInput1; RefInput2; }  # unwired: RefInput1, RefInput2

# group: <Func 0> M2
code_block_74 = CodeBlock { "TargetElements"; }
# note: <Func>
valueAtKey_21 = DesignScript.Builtin.Dictionary.ValueAtKey(dictionary=value_for_import_from_others_21.MainInput, key=code_block_74)

# group: Output Manager
reference_output_21 = CodeBlock { ref; }  # unwired: ref
output_21 = CodeBlock { MainOutput; RefOutput_geoColor; }  # unwired: MainOutput, RefOutput_geoColor

# group: Input Manager
value_for_import_from_others_22 = CodeBlock(MainInput=code_block_69) { MainInput; RefInput1; RefInput2; }  # unwired: RefInput1, RefInput2

# group: <Func 0> M2
code_block_75 = CodeBlock { "TargetElements"; }
# note: <Func>
valueAtKey_22 = DesignScript.Builtin.Dictionary.ValueAtKey(dictionary=value_for_import_from_others_22.MainInput, key=code_block_75)

# group: Output Manager
reference_output_22 = CodeBlock { ref; }  # unwired: ref
output_22 = CodeBlock { MainOutput; RefOutput_geoColor; }  # unwired: MainOutput, RefOutput_geoColor

# group: Input Manager
value_for_import_from_others_23 = CodeBlock(MainInput=code_block_69) { MainInput; RefInput1; RefInput2; }  # unwired: RefInput1, RefInput2

# group: <Func 0> M2
code_block_76 = CodeBlock { "TargetElements"; }
# note: <Func>
valueAtKey_23 = DesignScript.Builtin.Dictionary.ValueAtKey(dictionary=value_for_import_from_others_23.MainInput, key=code_block_76)

# group: Output Manager
output_23 = CodeBlock { MainOutput; RefOutput_geoColor; }  # unwired: MainOutput, RefOutput_geoColor
reference_output_23 = CodeBlock { ref; }  # unwired: ref

code_block_77 = CodeBlock(i=select_target_family_element_and_5) { i; }

# group: Input Manager
value_for_import_from_others_24 = CodeBlock(MainInput=code_block_77) { MainInput; RefInput1; RefInput2; }  # unwired: RefInput1, RefInput2

# group: <Func 0> M
code_block_78 = CodeBlock { "TargetElements"; }
# note: <Func>
valueAtKey_24 = DesignScript.Builtin.Dictionary.ValueAtKey(dictionary=value_for_import_from_others_24.MainInput, key=code_block_78)

# group: Output Manager
output_24 = CodeBlock { MainOutput; RefOutput_geoColor; }  # unwired: MainOutput, RefOutput_geoColor
reference_output_24 = CodeBlock { ref; }  # unwired: ref

# group: Input Manager
value_for_import_from_others_25 = CodeBlock(MainInput=code_block_77) { MainInput; RefInput1; RefInput2; }  # unwired: RefInput1, RefInput2

# group: <Func 0> M
code_block_79 = CodeBlock { "TargetElements"; }
# note: <Func>
valueAtKey_25 = DesignScript.Builtin.Dictionary.ValueAtKey(dictionary=value_for_import_from_others_25.MainInput, key=code_block_79)
