# Dynamo graph 13 Furniture (1220).dyn (Dynamo 2.12.0.5650)

# group: Primary Input : Excel & Revit Elements
categories = Categories("OST_Furniture")
all_elements_of_category = ElementsOfCategory(Category=categories)
string_from_web = Python()  # CPython3; unwired: IN[0]
# ---------- string_from_web.python (19 lines) ----------
# Load the Python Standard and DesignScript Libraries
import sys
import clr
clr.AddReference('ProtoGeometry')
from Autodesk.DesignScript.Geometry import *
import urllib.request

# The inputs to this node will be stored as a list in the IN variables.
dataEnteringNode = IN
inputURL = "https://raw.githubusercontent.com/HNANmal/mQ/master/Hdynlib/General/ImportExcel.py"

# Place your code below this line
req = urllib.request
data = req.urlopen(inputURL)

result = data.read().decode("utf-8")

# Assign your output to the OUT variable.
OUT = result
# ----------------------------------------
file_path = Filename(".\BIM_물량집계 자동화 산출기준표_rC(20211207)_강한호 (1).xlsx")  # graph input
sheet_name = CodeBlock { "Furniture"; }
github_python_import_excel_by = PythonStringNode(script=string_from_web, IN[0]=file_path, IN[1]=sheet_name)  # "Github_Python@Import Excel(By OpenpyXl)"; CPython3
code_block = CodeBlock(InputElement=all_elements_of_category, InputData=github_python_import_excel_by) { _InputElement; _InputData; }

# group: GetFull WMCodeDescription PerElement
excelDataManagerNode = Python(IN[0]=code_block._InputElement, IN[1]=code_block._InputData)  # CPython3
# ---------- excelDataManagerNode.python (279 lines) ----------
# Load the Python Standard and DesignScript Libraries
import os
import sys
sys.path.append(os.getenv('LOCALAPPDATA').replace('\\','\\\\') + r'\Programs\Python\Python39\Lib\site-packages')
import clr
clr.AddReference('RevitAPI')
import Autodesk

clr.AddReference('ProtoGeometry')
from Autodesk.DesignScript.Geometry import *

clr.AddReference('RevitNodes')
import Revit
clr.ImportExtensions(Revit.Elements)

clr.ImportExtensions(Revit.GeometryConversion)
clr.ImportExtensions(Revit.GeometryReferences)

clr.AddReference('RevitServices')
import RevitServices
from RevitServices.Persistence import DocumentManager
from RevitServices.Transactions import TransactionManager

doc = DocumentManager.Instance.CurrentDBDocument

import random
import itertools
from functools import reduce
from collections import Iterable
import datetime
import openpyxl

def iterable(obj):
    return isinstance(obj, Iterable)

def findUnique(inputs):
    result = []
    for i in inputs:
        if i in result:
            pass
        else:
            result.append(i)
    return result

# The inputs to this node will be stored as a list in the IN variables.
dataEnteringNode = IN
inputElements = IN[0]
inputData = IN[1]
#inputSheetName = IN[2]

def importExcel(path, SheetNameIn):
    wb_obj = openpyxl.load_workbook(str(path), data_only=True)
    sheet_obj = wb_obj.get_sheet_by_name(str(SheetNameIn))

    m_row = sheet_obj.max_row
    m_col = sheet_obj.max_column

    listOut = []

    for i in range(1, m_row +1):
        listTemp = []
        for j in range(1, m_col + 1):
            cell_obj = sheet_obj.cell(row=i, column=j)
            listTemp.append(cell_obj.value)
            if len(listTemp) == m_col:
                listOut.append(listTemp)
    return listOut

def getUsedFamilyTypeOfModeling(elements):
    familyCode = list(map(lambda x: x.Name.split('_')[0], elements))
    unq_familyCode = findUnique(familyCode)
    return unq_familyCode
    
def createExcelDataDictionary(values):
    result = {}
    for i in range(len(values)):
        result[str(i)] = values[i]
    return result

def findTargetIndex(targets, list):
    result = []
    for target in targets:
        for i in range(len(list)):
            if target in str(list[i]):
                result.append(i)
            else:
                pass
    result.sort()
    return result
    
def GetValueAtKeys(keys, dictionary):
    result = [] 
    for i in keys:
        result.append(dictionary[str(i)])
    return result


# Place your code below this line
usedFamilyTypeOfModeling = getUsedFamilyTypeOfModeling(inputElements)
excelWholeDataSet = inputData#importExcel(inputFilePath, inputSheetName)
trExcelWholeDataSet = list(zip(*excelWholeDataSet))
excelColumnDataSet = createExcelDataDictionary(trExcelWholeDataSet)
excelRowDataSet = createExcelDataDictionary(excelWholeDataSet)
ColumnIndexOfUsedFamilyType = findTargetIndex(usedFamilyTypeOfModeling, trExcelWholeDataSet)
ColDataSetOfUsedFamilyType = GetValueAtKeys(ColumnIndexOfUsedFamilyType, excelColumnDataSet)
materialPerElementFromModeling = []
for i in inputElements:
    materialPerElementFromModeling.append(i.GetMaterials())
#list(map(lambda x: x.GetMaterials, inputElements)) "맵함수로 처리하면 리스트화 할 때 타입 변환 오류 남"

targetWMRowIndex = []
for i in ColDataSetOfUsedFamilyType:
    targetWMRowIndex.append(findTargetIndex(['000'], i))

rowDataSetOfUsedWM = []
for i in targetWMRowIndex:
    rowDataSetOfUsedWM.append(GetValueAtKeys(i, excelRowDataSet))

workGroup = []
for i in rowDataSetOfUsedWM:
    tmp = []
    for j in i:
        tmp.append(j[0])
    workGroup.append(tmp)
    
workMaster = []
for i in range(len(ColDataSetOfUsedFamilyType)):
    tmp=[]
    for k in targetWMRowIndex[i]:
        tmp.append(ColDataSetOfUsedFamilyType[i][k])
    workMaster.append(tmp)

matchedWM = []
for i in range(len(workGroup)):
    tmp = []
    for j in range(len(workGroup[i])):
        fullWM = workGroup[i][j] +"-"+ workMaster[i][j]
        tmp.append(fullWM)
    matchedWM.append(tmp)

matchedWorkGruopAndMasterCode = []
for i in matchedWM:
    if len(i) > 0:
        matchedWorkGruopAndMasterCode.append(i)
    else:
        pass

matchedWMDescription = []
for i in rowDataSetOfUsedWM:
    tmp=[]
    for j in i:
        tmp.append(j[1] +" "+ j[2] +" "+ j[3] +" "+ "("+ j[4] +")")
    if len(tmp) > 0:
        matchedWMDescription.append(tmp)
    else:
        pass

matchedWMUnit = []
for i in rowDataSetOfUsedWM:
    tmp=[]
    for j in i:
        tmp.append(j[4])
    if len(tmp) > 0:
        matchedWMUnit.append(tmp)
    else:
        pass

matchedWorkGruopAndMasterCode_flat = list(itertools.chain(*matchedWorkGruopAndMasterCode))
matchedWMDescription_flat = list(itertools.chain(*matchedWMDescription))

dic_WMandDescription_Excel = {}
for i in range(len(matchedWorkGruopAndMasterCode_flat)):
    dic_WMandDescription_Excel[matchedWorkGruopAndMasterCode_flat[i]] = matchedWMDescription_flat[i]

usedFamilyTypeInExcelOrder = list(map(lambda x: x[3], ColDataSetOfUsedFamilyType))
usedFamilyCodeInExcelOrder = findUnique(list(map(lambda x: x.split('_')[0], usedFamilyTypeInExcelOrder)))

dic_FamilyCodeandWM = {}
for i in range(len(usedFamilyCodeInExcelOrder)):
    dic_FamilyCodeandWM[usedFamilyCodeInExcelOrder[i]] = matchedWorkGruopAndMasterCode[i]

workMasterCodePerElement = []
familyCodePerElem = list(map(lambda x: x.Name.split('_')[0], inputElements))
for i in familyCodePerElem:
    workMasterCodePerElement.append(dic_FamilyCodeandWM[i])

materialNamePerElem = []
for i in materialPerElementFromModeling:
    tmp = []
    for j in i:
        tmp.append(j.Name)
    materialNamePerElem.append(tmp)

WMPerElementFromModeling = []
for i in materialNamePerElem:
    tmp = []
    for j in i:
        tmp.append(j.split('_')[0])
    WMPerElementFromModeling.append(tmp)

specPerElementFromModeling = []
for i in materialNamePerElem:
    tmp = []
    for j in i:
        a = j.split('_')
        del a[0]
        b = " ".join(a)
        tmp.append(b)
    specPerElementFromModeling.append(tmp)

WMPerElementFromModeling_flat = list(itertools.chain(*WMPerElementFromModeling))
specPerElementFromModeling_flat = list(itertools.chain(*specPerElementFromModeling))

dic_WMandDescription_Model = {}
for i in range(len(WMPerElementFromModeling_flat)):
    dic_WMandDescription_Model[WMPerElementFromModeling_flat[i]] = specPerElementFromModeling_flat[i]

def findAllKeys(dict):
    result = []
    for key in dict.keys():
        result.append(key)
    return result

def findAllValues(dict):
    result = []
    for key in dict.keys():
        result.append(dict[key])
    return result

keys_WMandDescription_Model = findAllKeys(dic_WMandDescription_Model)
keys_WMandDescription_Excel = findAllKeys(dic_WMandDescription_Excel)

keys_WMandDescription_Both = list(set(keys_WMandDescription_Model + keys_WMandDescription_Excel))
values_WMandDescription_Both = []
for i in keys_WMandDescription_Both:
    if i in keys_WMandDescription_Model:
        values_WMandDescription_Both.append(dic_WMandDescription_Model[i])
    else:
        values_WMandDescription_Both.append(dic_WMandDescription_Excel[i])

dic_WMandDescription_Both = {}
for i in range(len(keys_WMandDescription_Both)):
    dic_WMandDescription_Both[keys_WMandDescription_Both[i]] = values_WMandDescription_Both[i]

workMasterCodePerElementFromBoth = []
for i in range(len(workMasterCodePerElement)):
    #tmp = []
    a = WMPerElementFromModeling[i] + workMasterCodePerElement[i]
    b = findUnique(a)
    workMasterCodePerElementFromBoth.append(b)

specPerElement = []
for i in workMasterCodePerElementFromBoth:
    tmp = []
    for j in i:
        tmp.append(dic_WMandDescription_Both[j])
    specPerElement.append(tmp)

fullWMCodeDescriptionPerElement = []
for i in range(len(workMasterCodePerElementFromBoth)):
    tmp = []
    for j in range(len(workMasterCodePerElementFromBoth[i])):
        a = workMasterCodePerElementFromBoth[i][j] +": "+ specPerElement[i][j]
        tmp.append(a)
    fullWMCodeDescriptionPerElement.append(tmp)

fullWMinfo = {
"AllElement": inputElements,
"WorkMasterCodePerFamilyType": dic_FamilyCodeandWM,
"WorkMasterCodePerElementBoth": workMasterCodePerElementFromBoth,
"FullWMCodeDescriptionPerElement": fullWMCodeDescriptionPerElement
}



result = fullWMinfo

# Assign your output to the OUT variable.
OUT = result
# ----------------------------------------

# group: OrganizeAllElementInformAsDictionary
organizeAllElementInformAsDictionary = Custom[OrganizeAllElementInformAsDictionary](InputDic=excelDataManagerNode)  # OrganizeAllElementInformAsDictionary

# group: Select Target Family Element And Connected WorkMasters
code_block_2 = CodeBlock { [0,1]; }
selectTargetFamilyInformAsDictionary = Custom[SelectTargetFamilyInformAsDictionary](InputDic=organizeAllElementInformAsDictionary, InputIndex=code_block_2)  # Select Target Family Element And Connected WorkMasters

watch = Watch(selectTargetFamilyInformAsDictionary)
code_block_3 = CodeBlock(i=watch) { i; }

# group: <Func 1> 길이합계 (Top Rails 길이 산출)
code_block_4 = CodeBlock { "TargetElements"; }
valueAtKey = DesignScript.Builtin.Dictionary.ValueAtKey(dictionary=code_block_3, key=code_block_4)
code_block_5 = CodeBlock { "Length"; }
getParameterValueByName = Element.GetParameterValueByName(parameterName=code_block_5)  # unwired: element

count = List.Count(list=valueAtKey@L2)
geometry = Element.Geometry(element=valueAtKey)
code_block_6 = CodeBlock(i=selectTargetFamilyInformAsDictionary) { i; }

# group: Input Manager
value_for_import_from_others = CodeBlock(MainInput=code_block_6) { MainInput; RefInput1; RefInput2; }  # unwired: RefInput1, RefInput2

# group: <Func 1>EA
volume = Solid.Volume()  # unwired: solid
code_block_7 = CodeBlock { "TargetElements"; }
# note: <Func>
valueAtKey_2 = DesignScript.Builtin.Dictionary.ValueAtKey(dictionary=value_for_import_from_others.MainInput, key=code_block_7)
code_block_8 = CodeBlock()  # unwired: FuncValues, FuncValuesUnit
# ---------- code_block_8.designscript (4 lines) ----------
{
"FuncValues": _FuncValues,
"FuncValuesUnit": _FuncValuesUnit
};
# ----------------------------------------

# group: Output Manager
reference_output = CodeBlock { ref; }  # unwired: ref
output = CodeBlock(MainOutput=code_block_8) { MainOutput; RefOutput_geoColor; }  # unwired: RefOutput_geoColor

# group: Visual Manager
visual_켜기_끄기 = BoolSelector(false)
visual_manager = Python(IN[0]=output.RefOutput_geoColor, IN[1]=visual_켜기_끄기)  # CPython3
# ---------- visual_manager.python (18 lines) ----------
# Load the Python Standard and DesignScript Libraries
import sys
import clr
clr.AddReference('ProtoGeometry')
from Autodesk.DesignScript.Geometry import *

# The inputs to this node will be stored as a list in the IN variables.
dataEnteringNode = IN
geoColors = IN[0]
blnForVisual = IN[1]

# Place your code below this line
if blnForVisual == True:
    result = geoColors
else:
    result = 0
# Assign your output to the OUT variable.
OUT = result
# ----------------------------------------
