# Dynamo graph 14 Generic Model (1220).dyn (Dynamo 2.12.0.5650)

# group: Primary Input : Excel & Revit Elements
categories = Categories("OST_GenericModel")
all_elements_of_category = ElementsOfCategory(Category=categories)
string_from_web = Python()  # CPython3; unwired: IN[0]
# ---------- string_from_web.python (19 lines) ----------
# Load the Python Standard and DesignScript Libraries
import sys
import clr
clr.AddReference('ProtoGeometry')
from Autodesk.DesignScript.Geometry import *
import urllib.request

# The inputs to this node will be stored as a list in the IN variables.
dataEnteringNode = IN
inputURL = "https://raw.githubusercontent.com/HNANmal/mQ/master/Hdynlib/General/ImportExcel.py"

# Place your code below this line
req = urllib.request
data = req.urlopen(inputURL)

result = data.read().decode("utf-8")

# Assign your output to the OUT variable.
OUT = result
# ----------------------------------------
file_path = Filename(".\DMS(Data Matching Schedule)_R0(Seq.0-1).xlsx")  # graph input
sheet_name = CodeBlock { "Generic"; }
github_python_import_excel_by = PythonStringNode(script=string_from_web, IN[0]=file_path, IN[1]=sheet_name)  # "Github_Python@Import Excel(By OpenpyXl)"; CPython3
code_block = CodeBlock(InputElement=all_elements_of_category, InputData=github_python_import_excel_by) { _InputElement; _InputData; }

# group: GetFull WMCodeDescription PerElement
excelDataManagerNode = Python(IN[0]=code_block._InputElement, IN[1]=code_block._InputData)  # CPython3
# ---------- excelDataManagerNode.python (279 lines) ----------
# Load the Python Standard and DesignScript Libraries
import os
import sys
sys.path.append(os.getenv('LOCALAPPDATA').replace('\\','\\\\') + r'\Programs\Python\Python39\Lib\site-packages')
import clr
clr.AddReference('RevitAPI')
import Autodesk

clr.AddReference('ProtoGeometry')
from Autodesk.DesignScript.Geometry import *

clr.AddReference('RevitNodes')
import Revit
clr.ImportExtensions(Revit.Elements)

clr.ImportExtensions(Revit.GeometryConversion)
clr.ImportExtensions(Revit.GeometryReferences)

clr.AddReference('RevitServices')
import RevitServices
from RevitServices.Persistence import DocumentManager
from RevitServices.Transactions import TransactionManager

doc = DocumentManager.Instance.CurrentDBDocument

import random
import itertools
from functools import reduce
from collections import Iterable
import datetime
import openpyxl

def iterable(obj):
    return isinstance(obj, Iterable)

def findUnique(inputs):
    result = []
    for i in inputs:
        if i in result:
            pass
        else:
            result.append(i)
    return result

# The inputs to this node will be stored as a list in the IN variables.
dataEnteringNode = IN
inputElements = IN[0]
inputData = IN[1]
#inputSheetName = IN[2]

def importExcel(path, SheetNameIn):
    wb_obj = openpyxl.load_workbook(str(path), data_only=True)
    sheet_obj = wb_obj.get_sheet_by_name(str(SheetNameIn))

    m_row = sheet_obj.max_row
    m_col = sheet_obj.max_column

    listOut = []

    for i in range(1, m_row +1):
        listTemp = []
        for j in range(1, m_col + 1):
            cell_obj = sheet_obj.cell(row=i, column=j)
            listTemp.append(cell_obj.value)
            if len(listTemp) == m_col:
                listOut.append(listTemp)
    return listOut

def getUsedFamilyTypeOfModeling(elements):
    familyCode = list(map(lambda x: x.Name.split('_')[0], elements))
    unq_familyCode = findUnique(familyCode)
    return unq_familyCode
    
def createExcelDataDictionary(values):
    result = {}
    for i in range(len(values)):
        result[str(i)] = values[i]
    return result

def findTargetIndex(targets, list):
    result = []
    for target in targets:
        for i in range(len(list)):
            if target in str(list[i]):
                result.append(i)
            else:
                pass
    result.sort()
    return result
    
def GetValueAtKeys(keys, dictionary):
    result = [] 
    for i in keys:
        result.append(dictionary[str(i)])
    return result


# Place your code below this line
usedFamilyTypeOfModeling = getUsedFamilyTypeOfModeling(inputElements)
excelWholeDataSet = inputData#importExcel(inputFilePath, inputSheetName)
trExcelWholeDataSet = list(zip(*excelWholeDataSet))
excelColumnDataSet = createExcelDataDictionary(trExcelWholeDataSet)
excelRowDataSet = createExcelDataDictionary(excelWholeDataSet)
ColumnIndexOfUsedFamilyType = findTargetIndex(usedFamilyTypeOfModeling, trExcelWholeDataSet)
ColDataSetOfUsedFamilyType = GetValueAtKeys(ColumnIndexOfUsedFamilyType, excelColumnDataSet)
materialPerElementFromModeling = []
for i in inputElements:
    materialPerElementFromModeling.append(i.GetMaterials())
#list(map(lambda x: x.GetMaterials, inputElements)) "맵함수로 처리하면 리스트화 할 때 타입 변환 오류 남"

targetWMRowIndex = []
for i in ColDataSetOfUsedFamilyType:
    targetWMRowIndex.append(findTargetIndex(['000'], i))

rowDataSetOfUsedWM = []
for i in targetWMRowIndex:
    rowDataSetOfUsedWM.append(GetValueAtKeys(i, excelRowDataSet))

workGroup = []
for i in rowDataSetOfUsedWM:
    tmp = []
    for j in i:
        tmp.append(j[0])
    workGroup.append(tmp)
    
workMaster = []
for i in range(len(ColDataSetOfUsedFamilyType)):
    tmp=[]
    for k in targetWMRowIndex[i]:
        tmp.append(ColDataSetOfUsedFamilyType[i][k])
    workMaster.append(tmp)

matchedWM = []
for i in range(len(workGroup)):
    tmp = []
    for j in range(len(workGroup[i])):
        fullWM = workGroup[i][j] +"-"+ workMaster[i][j]
        tmp.append(fullWM)
    matchedWM.append(tmp)

matchedWorkGruopAndMasterCode = []
for i in matchedWM:
    if len(i) > 0:
        matchedWorkGruopAndMasterCode.append(i)
    else:
        pass

matchedWMDescription = []
for i in rowDataSetOfUsedWM:
    tmp=[]
    for j in i:
        tmp.append(j[1] +" "+ j[2] +" "+ j[3] +" "+ "("+ j[4] +")")
    if len(tmp) > 0:
        matchedWMDescription.append(tmp)
    else:
        pass

matchedWMUnit = []
for i in rowDataSetOfUsedWM:
    tmp=[]
    for j in i:
        tmp.append(j[4])
    if len(tmp) > 0:
        matchedWMUnit.append(tmp)
    else:
        pass

matchedWorkGruopAndMasterCode_flat = list(itertools.chain(*matchedWorkGruopAndMasterCode))
matchedWMDescription_flat = list(itertools.chain(*matchedWMDescription))

dic_WMandDescription_Excel = {}
for i in range(len(matchedWorkGruopAndMasterCode_flat)):
    dic_WMandDescription_Excel[matchedWorkGruopAndMasterCode_flat[i]] = matchedWMDescription_flat[i]

usedFamilyTypeInExcelOrder = list(map(lambda x: x[3], ColDataSetOfUsedFamilyType))
usedFamilyCodeInExcelOrder = findUnique(list(map(lambda x: x.split('_')[0], usedFamilyTypeInExcelOrder)))

dic_FamilyCodeandWM = {}
for i in range(len(usedFamilyCodeInExcelOrder)):
    dic_FamilyCodeandWM[usedFamilyCodeInExcelOrder[i]] = matchedWorkGruopAndMasterCode[i]

workMasterCodePerElement = []
familyCodePerElem = list(map(lambda x: x.Name.split('_')[0], inputElements))
for i in familyCodePerElem:
    workMasterCodePerElement.append(dic_FamilyCodeandWM[i])

materialNamePerElem = []
for i in materialPerElementFromModeling:
    tmp = []
    for j in i:
        tmp.append(j.Name)
    materialNamePerElem.append(tmp)

WMPerElementFromModeling = []
for i in materialNamePerElem:
    tmp = []
    for j in i:
        tmp.append(j.split('_')[0])
    WMPerElementFromModeling.append(tmp)

specPerElementFromModeling = []
for i in materialNamePerElem:
    tmp = []
    for j in i:
        a = j.split('_')
        del a[0]
        b = " ".join(a)
        tmp.append(b)
    specPerElementFromModeling.append(tmp)

WMPerElementFromModeling_flat = list(itertools.chain(*WMPerElementFromModeling))
specPerElementFromModeling_flat = list(itertools.chain(*specPerElementFromModeling))

dic_WMandDescription_Model = {}
for i in range(len(WMPerElementFromModeling_flat)):
    dic_WMandDescription_Model[WMPerElementFromModeling_flat[i]] = specPerElementFromModeling_flat[i]

def findAllKeys(dict):
    result = []
    for key in dict.keys():
        result.append(key)
    return result

def findAllValues(dict):
    result = []
    for key in dict.keys():
        result.append(dict[key])
    return result

keys_WMandDescription_Model = findAllKeys(dic_WMandDescription_Model)
keys_WMandDescription_Excel = findAllKeys(dic_WMandDescription_Excel)

keys_WMandDescription_Both = list(set(keys_WMandDescription_Model + keys_WMandDescription_Excel))
values_WMandDescription_Both = []
for i in keys_WMandDescription_Both:
    if i in keys_WMandDescription_Model:
        values_WMandDescription_Both.append(dic_WMandDescription_Model[i])
    else:
        values_WMandDescription_Both.append(dic_WMandDescription_Excel[i])

dic_WMandDescription_Both = {}
for i in range(len(keys_WMandDescription_Both)):
    dic_WMandDescription_Both[keys_WMandDescription_Both[i]] = values_WMandDescription_Both[i]

workMasterCodePerElementFromBoth = []
for i in range(len(workMasterCodePerElement)):
    #tmp = []
    a = WMPerElementFromModeling[i] + workMasterCodePerElement[i]
    b = findUnique(a)
    workMasterCodePerElementFromBoth.append(b)

specPerElement = []
for i in workMasterCodePerElementFromBoth:
    tmp = []
    for j in i:
        tmp.append(dic_WMandDescription_Both[j])
    specPerElement.append(tmp)

fullWMCodeDescriptionPerElement = []
for i in range(len(workMasterCodePerElementFromBoth)):
    tmp = []
    for j in range(len(workMasterCodePerElementFromBoth[i])):
        a = workMasterCodePerElementFromBoth[i][j] +": "+ specPerElement[i][j]
        tmp.append(a)
    fullWMCodeDescriptionPerElement.append(tmp)

fullWMinfo = {
"AllElement": inputElements,
"WorkMasterCodePerFamilyType": dic_FamilyCodeandWM,
"WorkMasterCodePerElementBoth": workMasterCodePerElementFromBoth,
"FullWMCodeDescriptionPerElement": fullWMCodeDescriptionPerElement
}



result = fullWMinfo

# Assign your output to the OUT variable.
OUT = result
# ----------------------------------------

# group: OrganizeAllElementInformAsDictionary
organizeAllElementInformAsDictionary = Custom[OrganizeAllElementInformAsDictionary](InputDic=excelDataManagerNode)  # OrganizeAllElementInformAsDictionary

# group: Select Target Family Element And Connected WorkMasters
code_block_2 = CodeBlock { 0..1; }
selectTargetFamilyInformAsDictionary = Custom[SelectTargetFamilyInformAsDictionary](InputDic=organizeAllElementInformAsDictionary, InputIndex=code_block_2)  # Select Target Family Element And Connected WorkMasters

watch = Watch(selectTargetFamilyInformAsDictionary)

# group: <Func 2> 측면 면적산출
code_block_3 = CodeBlock { "TargetElements"; }
valueAtKey = DesignScript.Builtin.Dictionary.ValueAtKey(key=code_block_3)  # unwired: dictionary
# note: <Func>
extractSideFacesOfElement = Custom[ExtractSideFacesOfElement](Element=valueAtKey)  # ExtractSideFacesOfElement
geometry = Element.Geometry(element=valueAtKey)

extractUpperFacesOfElement = Custom[ExtractUpperFacesOfElement](Element=valueAtKey)  # ExtractUpperFacesOfElement
flatten = List.Flatten(list=valueAtKey)
elementType = Element.ElementType(element=flatten)
familyName = ElementType.FamilyName(elementType=elementType)
code_block_4 = CodeBlock { "ladder"; "Downpipe"; "sink"; }
contains = String.Contains(string=familyName, searchFor=code_block_4.out0, ignoreCase=code_block_4.out2)
filterByBoolMask = List.FilterByBoolMask(mask=contains)  # unwired: list
count = List.Count(list=filterByBoolMask.in@L2)
watch_2 = Watch(count)
contains_2 = String.Contains(string=familyName, searchFor=code_block_4.out0)
filterByBoolMask_2 = List.FilterByBoolMask(list=flatten, mask=contains_2)
code_block_5 = CodeBlock { "Ladder_Length"; }
getParameterValueByName = Element.GetParameterValueByName(element=filterByBoolMask_2.in, parameterName=code_block_5)
watch_3 = Watch(getParameterValueByName)
sum = Math.Sum(values=watch_3)
watch_4 = Watch(sum)
contains_3 = String.Contains(string=familyName, searchFor=code_block_4.out1)
filterByBoolMask_3 = List.FilterByBoolMask(list=flatten, mask=contains_3)
code_block_6 = CodeBlock { "Length_System"; }
getParameterValueByName_2 = Element.GetParameterValueByName(element=filterByBoolMask_3.in, parameterName=code_block_6)
watch_5 = Watch(getParameterValueByName_2)
round = Math.Round(number=watch_5)
sum_2 = Math.Sum(values=round)
watch_6 = Watch(sum_2)

# group: Sample
code_block_7 = CodeBlock {  }
code_block_8 = CodeBlock {  }

code_block_9 = CodeBlock { i; }  # unwired: i

# group: Input Manager
value_for_import_from_others = CodeBlock(MainInput=code_block_9) { MainInput; RefInput1; RefInput2; }  # unwired: RefInput1, RefInput2

# group: <Func 9>Lean Concrete
code_block_10 = CodeBlock { "TargetElements"; }
valueAtKey_2 = DesignScript.Builtin.Dictionary.ValueAtKey(dictionary=value_for_import_from_others.MainInput, key=code_block_10)
code_block_11 = CodeBlock { 0; 100; }
# note: <Func>
createLeanConcrete = Custom[CreateLeanConcrete](Element=valueAtKey_2, leanOffset=code_block_11.out0, leanThick=code_block_11.out1)  # CreateLeanConcreteForISOFDN
volume = Solid.Volume(solid=createLeanConcrete.Solid)
code_block_12 = CodeBlock(i=volume) { Math.Round(List.Flatten(i)/1000000000, 2); }
code_block_13 = CodeBlock { "M3"; }
count_2 = List.Count(list=code_block_12)
ofRepeatedItem = List.OfRepeatedItem(item=code_block_13, amount=count_2)
code_block_14 = CodeBlock(FuncValues=code_block_12, FuncValuesUnit=ofRepeatedItem)
# ---------- code_block_14.designscript (4 lines) ----------
{
"FuncValues": _FuncValues,
"FuncValuesUnit": _FuncValuesUnit
};
# ----------------------------------------

# group: Output Manager
output = CodeBlock(MainOutput=code_block_14, RefOutput_geoColor=createLeanConcrete.Solid) { MainOutput; RefOutput_geoColor; }
reference_output = CodeBlock(ref=createLeanConcrete.Solid) { ref; }

# group: Visual Manager
visual_켜기_끄기 = BoolSelector(false)
visual_manager = Python(IN[0]=output.RefOutput_geoColor, IN[1]=visual_켜기_끄기)  # CPython3
# ---------- visual_manager.python (18 lines) ----------
# Load the Python Standard and DesignScript Libraries
import sys
import clr
clr.AddReference('ProtoGeometry')
from Autodesk.DesignScript.Geometry import *

# The inputs to this node will be stored as a list in the IN variables.
dataEnteringNode = IN
geoColors = IN[0]
blnForVisual = IN[1]

# Place your code below this line
if blnForVisual == True:
    result = geoColors
else:
    result = 0
# Assign your output to the OUT variable.
OUT = result
# ----------------------------------------

join = List.Join(list0=output.MainOutput)  # unwired: list1, list2, list3, list4, list5, list6, list7, list8, list9, list10

# group: TargetWMunique + Data Sending
code_block_15 = CodeBlock(InputDic2=join) { _InputDic2; }
count_3 = List.Count(list=code_block_15)
code_block_16 = CodeBlock(InputDic1=code_block_9) { _InputDic1; }
code_block_17 = CodeBlock { "TargetWMunique"; }
valueAtKey_3 = DesignScript.Builtin.Dictionary.ValueAtKey(dictionary=code_block_16, key=code_block_17)
watch_7 = Watch(valueAtKey_3)
count_4 = List.Count(list=watch_7)
eq = count_3 == count_4
organizeFuncValuesAndWorkMasterAsDiction = Custom[OrganizeFuncValuesAndWorkMasterAsDictionary](InputDic1=code_block_16, InputDic2=code_block_15)  # Organize FuncValues and WorkMaster As Dictionary
watch_8 = Watch()  # unwired: arg0
if_ = If(test=eq, true=organizeFuncValuesAndWorkMasterAsDiction, false=watch_8)

# group: Primary Input
categories_2 = Categories("OST_StructuralFoundation")
all_elements_of_category_2 = ElementsOfCategory(Category=categories_2)
file_path_2 = Filename("..\BIM_물량집계 자동화 산출기준표_rC(20211029).xlsx")
file_from_path = FileObject(path=file_path_2)
code_block_18 = CodeBlock { "Str Foundations"; }

# group: GetFull WMCodeDescription PerElement
code_block_19 = CodeBlock(InputElement=all_elements_of_category_2, InputFilePath=file_from_path, InputSheetName=code_block_18) { _InputElement; _InputFilePath; _InputSheetName; }
excelDataManagerNode_2 = Python(IN[0]=code_block_19._InputElement, IN[1]=code_block_19._InputFilePath, IN[2]=code_block_19._InputSheetName)  # CPython3
# ---------- excelDataManagerNode_2.python (279 lines) ----------
# Load the Python Standard and DesignScript Libraries
import os
import sys
sys.path.append(os.getenv('LOCALAPPDATA').replace('\\','\\\\') + r'\Programs\Python\Python39\Lib\site-packages')
import clr
clr.AddReference('RevitAPI')
import Autodesk

clr.AddReference('ProtoGeometry')
from Autodesk.DesignScript.Geometry import *

clr.AddReference('RevitNodes')
import Revit
clr.ImportExtensions(Revit.Elements)

clr.ImportExtensions(Revit.GeometryConversion)
clr.ImportExtensions(Revit.GeometryReferences)

clr.AddReference('RevitServices')
import RevitServices
from RevitServices.Persistence import DocumentManager
from RevitServices.Transactions import TransactionManager

doc = DocumentManager.Instance.CurrentDBDocument

import random
import itertools
from functools import reduce
from collections import Iterable
import datetime
import openpyxl

def iterable(obj):
    return isinstance(obj, Iterable)

def findUnique(inputs):
    result = []
    for i in inputs:
        if i in result:
            pass
        else:
            result.append(i)
    return result

# The inputs to this node will be stored as a list in the IN variables.
dataEnteringNode = IN
inputElements = IN[0]
inputFilePath = IN[1]
inputSheetName = IN[2]

def importExcel(path, SheetNameIn):
    wb_obj = openpyxl.load_workbook(str(path), data_only=True)
    sheet_obj = wb_obj.get_sheet_by_name(str(SheetNameIn))

    m_row = sheet_obj.max_row
    m_col = sheet_obj.max_column

    listOut = []

    for i in range(1, m_row +1):
        listTemp = []
        for j in range(1, m_col + 1):
            cell_obj = sheet_obj.cell(row=i, column=j)
            listTemp.append(cell_obj.value)
            if len(listTemp) == m_col:
                listOut.append(listTemp)
    return listOut

def getUsedFamilyTypeOfModeling(elements):
    familyCode = list(map(lambda x: x.Name.split('_')[0], elements))
    unq_familyCode = findUnique(familyCode)
    return unq_familyCode
    
def createExcelDataDictionary(values):
    result = {}
    for i in range(len(values)):
        result[str(i)] = values[i]
    return result

def findTargetIndex(targets, list):
    result = []
    for target in targets:
        for i in range(len(list)):
            if target in str(list[i]):
                result.append(i)
            else:
                pass
    result.sort()
    return result
    
def GetValueAtKeys(keys, dictionary):
    result = [] 
    for i in keys:
        result.append(dictionary[str(i)])
    return result


# Place your code below this line
usedFamilyTypeOfModeling = getUsedFamilyTypeOfModeling(inputElements)
excelWholeDataSet = importExcel(inputFilePath, inputSheetName)
trExcelWholeDataSet = list(zip(*excelWholeDataSet))
excelColumnDataSet = createExcelDataDictionary(trExcelWholeDataSet)
excelRowDataSet = createExcelDataDictionary(excelWholeDataSet)
ColumnIndexOfUsedFamilyType = findTargetIndex(usedFamilyTypeOfModeling, trExcelWholeDataSet)
ColDataSetOfUsedFamilyType = GetValueAtKeys(ColumnIndexOfUsedFamilyType, excelColumnDataSet)
materialPerElementFromModeling = []
for i in inputElements:
    materialPerElementFromModeling.append(i.GetMaterials())
#list(map(lambda x: x.GetMaterials, inputElements)) "맵함수로 처리하면 리스트화 할 때 타입 변환 오류 남"

targetWMRowIndex = []
for i in ColDataSetOfUsedFamilyType:
    targetWMRowIndex.append(findTargetIndex(['000'], i))

rowDataSetOfUsedWM = []
for i in targetWMRowIndex:
    rowDataSetOfUsedWM.append(GetValueAtKeys(i, excelRowDataSet))

workGroup = []
for i in rowDataSetOfUsedWM:
    tmp = []
    for j in i:
        tmp.append(j[0])
    workGroup.append(tmp)
    
workMaster = []
for i in range(len(ColDataSetOfUsedFamilyType)):
    tmp=[]
    for k in targetWMRowIndex[i]:
        tmp.append(ColDataSetOfUsedFamilyType[i][k])
    workMaster.append(tmp)

matchedWM = []
for i in range(len(workGroup)):
    tmp = []
    for j in range(len(workGroup[i])):
        fullWM = workGroup[i][j] +"-"+ workMaster[i][j]
        tmp.append(fullWM)
    matchedWM.append(tmp)

matchedWorkGruopAndMasterCode = []
for i in matchedWM:
    if len(i) > 0:
        matchedWorkGruopAndMasterCode.append(i)
    else:
        pass

matchedWMDescription = []
for i in rowDataSetOfUsedWM:
    tmp=[]
    for j in i:
        tmp.append(j[1] +" "+ j[2] +" "+ j[3] +" "+ "("+ j[4] +")")
    if len(tmp) > 0:
        matchedWMDescription.append(tmp)
    else:
        pass

matchedWMUnit = []
for i in rowDataSetOfUsedWM:
    tmp=[]
    for j in i:
        tmp.append(j[4])
    if len(tmp) > 0:
        matchedWMUnit.append(tmp)
    else:
        pass

matchedWorkGruopAndMasterCode_flat = list(itertools.chain(*matchedWorkGruopAndMasterCode))
matchedWMDescription_flat = list(itertools.chain(*matchedWMDescription))

dic_WMandDescription_Excel = {}
for i in range(len(matchedWorkGruopAndMasterCode_flat)):
    dic_WMandDescription_Excel[matchedWorkGruopAndMasterCode_flat[i]] = matchedWMDescription_flat[i]

usedFamilyTypeInExcelOrder = list(map(lambda x: x[3], ColDataSetOfUsedFamilyType))
usedFamilyCodeInExcelOrder = findUnique(list(map(lambda x: x.split('_')[0], usedFamilyTypeInExcelOrder)))

dic_FamilyCodeandWM = {}
for i in range(len(usedFamilyCodeInExcelOrder)):
    dic_FamilyCodeandWM[usedFamilyCodeInExcelOrder[i]] = matchedWorkGruopAndMasterCode[i]

workMasterCodePerElement = []
familyCodePerElem = list(map(lambda x: x.Name.split('_')[0], inputElements))
for i in familyCodePerElem:
    workMasterCodePerElement.append(dic_FamilyCodeandWM[i])

materialNamePerElem = []
for i in materialPerElementFromModeling:
    tmp = []
    for j in i:
        tmp.append(j.Name)
    materialNamePerElem.append(tmp)

WMPerElementFromModeling = []
for i in materialNamePerElem:
    tmp = []
    for j in i:
        tmp.append(j.split('_')[0])
    WMPerElementFromModeling.append(tmp)

specPerElementFromModeling = []
for i in materialNamePerElem:
    tmp = []
    for j in i:
        a = j.split('_')
        del a[0]
        b = " ".join(a)
        tmp.append(b)
    specPerElementFromModeling.append(tmp)

WMPerElementFromModeling_flat = list(itertools.chain(*WMPerElementFromModeling))
specPerElementFromModeling_flat = list(itertools.chain(*specPerElementFromModeling))

dic_WMandDescription_Model = {}
for i in range(len(WMPerElementFromModeling_flat)):
    dic_WMandDescription_Model[WMPerElementFromModeling_flat[i]] = specPerElementFromModeling_flat[i]

def findAllKeys(dict):
    result = []
    for key in dict.keys():
        result.append(key)
    return result

def findAllValues(dict):
    result = []
    for key in dict.keys():
        result.append(dict[key])
    return result

keys_WMandDescription_Model = findAllKeys(dic_WMandDescription_Model)
keys_WMandDescription_Excel = findAllKeys(dic_WMandDescription_Excel)

keys_WMandDescription_Both = list(set(keys_WMandDescription_Model + keys_WMandDescription_Excel))
values_WMandDescription_Both = []
for i in keys_WMandDescription_Both:
    if i in keys_WMandDescription_Model:
        values_WMandDescription_Both.append(dic_WMandDescription_Model[i])
    else:
        values_WMandDescription_Both.append(dic_WMandDescription_Excel[i])

dic_WMandDescription_Both = {}
for i in range(len(keys_WMandDescription_Both)):
    dic_WMandDescription_Both[keys_WMandDescription_Both[i]] = values_WMandDescription_Both[i]

workMasterCodePerElementFromBoth = []
for i in range(len(workMasterCodePerElement)):
    #tmp = []
    a = WMPerElementFromModeling[i] + workMasterCodePerElement[i]
    b = findUnique(a)
    workMasterCodePerElementFromBoth.append(b)

specPerElement = []
for i in workMasterCodePerElementFromBoth:
    tmp = []
    for j in i:
        tmp.append(dic_WMandDescription_Both[j])
    specPerElement.append(tmp)

fullWMCodeDescriptionPerElement = []
for i in range(len(workMasterCodePerElementFromBoth)):
    tmp = []
    for j in range(len(workMasterCodePerElementFromBoth[i])):
        a = workMasterCodePerElementFromBoth[i][j] +": "+ specPerElement[i][j]
        tmp.append(a)
    fullWMCodeDescriptionPerElement.append(tmp)

fullWMinfo = {
"AllElement": inputElements,
"WorkMasterCodePerFamilyType": dic_FamilyCodeandWM,
"WorkMasterCodePerElementBoth": workMasterCodePerElementFromBoth,
"FullWMCodeDescriptionPerElement": fullWMCodeDescriptionPerElement
}



result = fullWMinfo

# Assign your output to the OUT variable.
OUT = result
# ----------------------------------------

# group: Organize AllElementInform AsDictionary
set_up_all_element_inform_as = Python(IN[0]=excelDataManagerNode_2)  # "Set Up All Element Inform as Dictionary"; CPython3
# ---------- set_up_all_element_inform_as.python (119 lines) ----------
# Load the Python Standard and DesignScript Libraries
import os
import sys
sys.path.append(os.getenv('LOCALAPPDATA').replace('\\','\\\\') + r'\Programs\Python\Python39\Lib\site-packages')
import clr
clr.AddReference('RevitAPI')
import Autodesk

clr.AddReference('ProtoGeometry')
from Autodesk.DesignScript.Geometry import *

clr.AddReference('RevitNodes')
import Revit
clr.ImportExtensions(Revit.Elements)

clr.ImportExtensions(Revit.GeometryConversion)
clr.ImportExtensions(Revit.GeometryReferences)

clr.AddReference('RevitServices')
import RevitServices
from RevitServices.Persistence import DocumentManager
from RevitServices.Transactions import TransactionManager

doc = DocumentManager.Instance.CurrentDBDocument

import random
import itertools
from functools import reduce
from collections import Iterable
import datetime
import openpyxl

def iterable(obj):
    return isinstance(obj, Iterable)

def findUnique(inputs):
    result = []
    for i in inputs:
        if i in result:
            pass
        else:
            result.append(i)
    return result

# The inputs to this node will be stored as a list in the IN variables.
dataEnteringNode = IN
inputDict = IN[0]


def importExcel(path, SheetNameIn):
    wb_obj = openpyxl.load_workbook(str(path), data_only=True)
    sheet_obj = wb_obj.get_sheet_by_name(str(SheetNameIn))

    m_row = sheet_obj.max_row
    m_col = sheet_obj.max_column

    listOut = []

    for i in range(1, m_row +1):
        listTemp = []
        for j in range(1, m_col + 1):
            cell_obj = sheet_obj.cell(row=i, column=j)
            listTemp.append(cell_obj.value)
            if len(listTemp) == m_col:
                listOut.append(listTemp)
    return listOut

def getUsedFamilyTypeOfModeling(elements):
    familyCode = list(map(lambda x: x.Name.split('_')[0], elements))
    unq_familyCode = findUnique(familyCode)
    return unq_familyCode
    
def createExcelDataDictionary(values):
    result = {}
    for i in range(len(values)):
        result[str(i)] = values[i]
    return result

def findTargetIndex(targets, list):
    result = []
    for target in targets:
        for i in range(len(list)):
            if target in str(list[i]):
                result.append(i)
            else:
                pass
    result.sort()
    return result
    
def GetValueAtKeys(keys, dictionary):
    result = [] 
    for i in keys:
        result.append(dictionary[str(i)])
    return result


# Place your code below this line
element = inputDict["AllElement"]
elementType = []
for i in element:
    elementType.append(i.Name)
familyCode = []
for i in elementType:
    familyCode.append(i.split("_")[0])
fullWMCodeDescriptionPerElement = inputDict["FullWMCodeDescriptionPerElement"]

resultDict = {
"Element": element,
"ElementType": elementType,
"FamilyCode": familyCode,
"FullWMCodeDescriptionPerElement": fullWMCodeDescriptionPerElement
}



result = resultDict

# Assign your output to the OUT variable.
OUT = result
# ----------------------------------------

# group: Select Target Family Element And Connected WorkMasters
code_block_20 = CodeBlock { 1; }
select_target_family_element_and = Python(IN[0]=set_up_all_element_inform_as, IN[1]=code_block_20)  # "Select Target Family Element And Connected WorkMasters"; CPython3
# ---------- select_target_family_element_and.python (138 lines) ----------
# Load the Python Standard and DesignScript Libraries
import os
import sys
sys.path.append(os.getenv('LOCALAPPDATA').replace('\\','\\\\') + r'\Programs\Python\Python39\Lib\site-packages')
import clr
clr.AddReference('RevitAPI')
import Autodesk

clr.AddReference('ProtoGeometry')
from Autodesk.DesignScript.Geometry import *

clr.AddReference('RevitNodes')
import Revit
clr.ImportExtensions(Revit.Elements)

clr.ImportExtensions(Revit.GeometryConversion)
clr.ImportExtensions(Revit.GeometryReferences)

clr.AddReference('RevitServices')
import RevitServices
from RevitServices.Persistence import DocumentManager
from RevitServices.Transactions import TransactionManager

doc = DocumentManager.Instance.CurrentDBDocument

import random
import itertools
from functools import reduce
from collections import Iterable
import datetime
import openpyxl

def iterable(obj):
    return isinstance(obj, Iterable)

def findUnique(inputs):
    result = []
    for i in inputs:
        if i in result:
            pass
        else:
            result.append(i)
    return result

# The inputs to this node will be stored as a list in the IN variables.
dataEnteringNode = IN
inputDict = IN[0]
inputIndex = IN[1]


def importExcel(path, SheetNameIn):
    wb_obj = openpyxl.load_workbook(str(path), data_only=True)
    sheet_obj = wb_obj.get_sheet_by_name(str(SheetNameIn))

    m_row = sheet_obj.max_row
    m_col = sheet_obj.max_column

    listOut = []

    for i in range(1, m_row +1):
        listTemp = []
        for j in range(1, m_col + 1):
            cell_obj = sheet_obj.cell(row=i, column=j)
            listTemp.append(cell_obj.value)
            if len(listTemp) == m_col:
                listOut.append(listTemp)
    return listOut

def getUsedFamilyTypeOfModeling(elements):
    familyCode = list(map(lambda x: x.Name.split('_')[0], elements))
    unq_familyCode = findUnique(familyCode)
    return unq_familyCode
    
def createExcelDataDictionary(values):
    result = {}
    for i in range(len(values)):
        result[str(i)] = values[i]
    return result

def findTargetIndex(targets, list):
    result = []
    for target in targets:
        for i in range(len(list)):
            if target in str(list[i]):
                result.append(i)
            else:
                pass
    result.sort()
    return result
    
def GetValueAtKeys(keys, dictionary):
    result = [] 
    for i in keys:
        result.append(dictionary[str(i)])
    return result


# Place your code below this line
fullWMCodeDescriptionPerElement = inputDict["FullWMCodeDescriptionPerElement"]
element = inputDict["Element"]
familyCode = inputDict["FamilyCode"]
familyCode_unique = findUnique(familyCode)
targetFamilyCode = familyCode_unique[inputIndex]
targetIndex = []
for i in range(len(familyCode)):
    if targetFamilyCode in familyCode[i]:
        targetIndex.append(i)
    else:
        pass

targetElements = []
for i in targetIndex:
    targetElements.append(element[i])

targetFamilyCode = []
for i in targetIndex:
    targetFamilyCode.append(element[i].Name)

WMforTargetElements = []
for i in targetIndex:
    WMforTargetElements.append(fullWMCodeDescriptionPerElement[i])

WMforTargetElements_flat = list(itertools.chain(*WMforTargetElements))
targetWMunique = findUnique(WMforTargetElements_flat)

resultDict = {
"TargetElements": targetElements,
"TargetFamilyCode": targetFamilyCode,
"WMforTargetElements": WMforTargetElements,
"TargetWMunique": targetWMunique
}



result = resultDict

# Assign your output to the OUT variable.
OUT = result
# ----------------------------------------

watch_9 = Watch(select_target_family_element_and)

# group: Sample
code_block_21 = CodeBlock {  }
code_block_22 = CodeBlock {  }

# group: Primary Input : Excel & Revit Elements
categories_3 = Categories("OST_GenericModel")
all_elements_of_category_3 = ElementsOfCategory(Category=categories_3)
string_from_web_2 = Python()  # CPython3; unwired: IN[0]; same code as string_from_web
file_path_3 = Filename(".\DMS(Data Matching Schedule)_R0(Seq.0-1).xlsx")  # graph input
sheet_name_2 = CodeBlock { "Generic"; }
github_python_import_excel_by_2 = PythonStringNode(script=string_from_web_2, IN[0]=file_path_3, IN[1]=sheet_name_2)  # "Github_Python@Import Excel(By OpenpyXl)"; CPython3
code_block_23 = CodeBlock(InputElement=all_elements_of_category_3, InputData=github_python_import_excel_by_2) { _InputElement; _InputData; }

# group: GetFull WMCodeDescription PerElement
excelDataManagerNode_3 = Python(IN[0]=code_block_23._InputElement, IN[1]=code_block_23._InputData)  # CPython3; same code as excelDataManagerNode

# group: OrganizeAllElementInformAsDictionary
organizeAllElementInformAsDictionary_2 = Custom[OrganizeAllElementInformAsDictionary](InputDic=excelDataManagerNode_3)

# group: Select Target Family Element And Connected WorkMasters
code_block_24 = CodeBlock { 0..1; }
selectTargetFamilyInformAsDictionary_2 = Custom[SelectTargetFamilyInformAsDictionary](InputDic=organizeAllElementInformAsDictionary_2, InputIndex=code_block_24)

watch_10 = Watch(selectTargetFamilyInformAsDictionary_2)
code_block_25 = CodeBlock { i; }  # unwired: i

# group: Input Manager
value_for_import_from_others_2 = CodeBlock(MainInput=code_block_25) { MainInput; RefInput1; RefInput2; }  # unwired: RefInput1, RefInput2

# group: <Func 1>M
code_block_26 = CodeBlock { "TargetElements"; }
# note: <Func>
valueAtKey_4 = DesignScript.Builtin.Dictionary.ValueAtKey(dictionary=value_for_import_from_others_2.MainInput, key=code_block_26)
code_block_27 = CodeBlock()  # unwired: FuncValues, FuncValuesUnit; same code as code_block_14

# group: Output Manager
reference_output_2 = CodeBlock { ref; }  # unwired: ref
output_2 = CodeBlock(MainOutput=code_block_27) { MainOutput; RefOutput_geoColor; }  # unwired: RefOutput_geoColor

# group: Visual Manager
visual_켜기_끄기_2 = BoolSelector(false)
visual_manager_2 = Python(IN[0]=output_2.RefOutput_geoColor, IN[1]=visual_켜기_끄기_2)  # CPython3; same code as visual_manager

# group: Input Manager
value_for_import_from_others_3 = CodeBlock(MainInput=code_block_25) { MainInput; RefInput1; RefInput2; }  # unwired: RefInput1, RefInput2

# group: <Func 2>M
code_block_28 = CodeBlock()  # unwired: FuncValues, FuncValuesUnit; same code as code_block_14
code_block_29 = CodeBlock { "TargetElements"; }
# note: <Func>
valueAtKey_5 = DesignScript.Builtin.Dictionary.ValueAtKey(dictionary=value_for_import_from_others_3.MainInput, key=code_block_29)

# group: Output Manager
output_3 = CodeBlock(MainOutput=code_block_28) { MainOutput; RefOutput_geoColor; }  # unwired: RefOutput_geoColor
reference_output_3 = CodeBlock { ref; }  # unwired: ref

# group: Visual Manager
visual_켜기_끄기_3 = BoolSelector(false)
visual_manager_3 = Python(IN[0]=output_3.RefOutput_geoColor, IN[1]=visual_켜기_끄기_3)  # CPython3; same code as visual_manager

# group: Input Manager
value_for_import_from_others_4 = CodeBlock(MainInput=code_block_25) { MainInput; RefInput1; RefInput2; }  # unwired: RefInput1, RefInput2

# group: <Func 3>M
code_block_30 = CodeBlock()  # unwired: FuncValues, FuncValuesUnit; same code as code_block_14
code_block_31 = CodeBlock { "TargetElements"; }
# note: <Func>
valueAtKey_6 = DesignScript.Builtin.Dictionary.ValueAtKey(dictionary=value_for_import_from_others_4.MainInput, key=code_block_31)

# group: Output Manager
output_4 = CodeBlock(MainOutput=code_block_30) { MainOutput; RefOutput_geoColor; }  # unwired: RefOutput_geoColor
reference_output_4 = CodeBlock { ref; }  # unwired: ref

# group: Visual Manager
visual_켜기_끄기_4 = BoolSelector(false)
visual_manager_4 = Python(IN[0]=output_4.RefOutput_geoColor, IN[1]=visual_켜기_끄기_4)  # CPython3; same code as visual_manager
