# Dynamo graph 04 Str Foundation (220106 다른이름저장2) Slab edge 추가.dyn (Dynamo 2.12.0.5650)

# note: 되메우기기

code_block = CodeBlock { i; }  # unwired: i

# group: <Func 0> Input Manager
value_for_import_from_others = CodeBlock(MainInput=code_block) { MainInput; RefInput; }  # unwired: RefInput

# group: <Func 0> Structural Concrete
code_block_2 = CodeBlock { "TargetElements"; }
valueAtKey = DesignScript.Builtin.Dictionary.ValueAtKey(dictionary=value_for_import_from_others.MainInput, key=code_block_2)
code_block_3 = CodeBlock { "Volume"; }
# note: <Func>
getParameterValueByName = Element.GetParameterValueByName(element=valueAtKey, parameterName=code_block_3)
code_block_4 = CodeBlock(i=getParameterValueByName) { Math.Round(List.Flatten(i)/1, 2); }
code_block_5 = CodeBlock { "M3"; }
count = List.Count(list=code_block_4)
ofRepeatedItem = List.OfRepeatedItem(item=code_block_5, amount=count)
code_block_6 = CodeBlock(FuncValues=code_block_4, FuncValuesUnit=ofRepeatedItem)
# ---------- code_block_6.designscript (4 lines) ----------
{
"FuncValues": _FuncValues,
"FuncValuesUnit": _FuncValuesUnit
};
# ----------------------------------------

# group: <Func 0> Output Manager
output = CodeBlock(MainOutput=code_block_6) { MainOutput; RefOutput1; RefOutput2; }  # unwired: RefOutput1, RefOutput2
reference_output = CodeBlock { ref; }  # unwired: ref

# group: <Func 5> Input Manager
value_for_import_from_others_2 = CodeBlock(MainInput=code_block) { MainInput; RefInput; }  # unwired: RefInput

# group: <Func 5> Lean Concrete
code_block_7 = CodeBlock { "TargetElements"; }
valueAtKey_2 = DesignScript.Builtin.Dictionary.ValueAtKey(dictionary=value_for_import_from_others_2.MainInput, key=code_block_7)
# note: <Func>
createLeanConcrete = Custom[CreateLeanConcrete](Element=valueAtKey_2)  # CreateLeanConcreteForISOFDN
flatten = List.Flatten(list=createLeanConcrete.Solid)
value_for_export_to_others = CodeBlock(린콘크리트형상=flatten) { 린콘크리트형상; }
volume = Solid.Volume(solid=createLeanConcrete.Solid)
code_block_8 = CodeBlock(i=volume) { Math.Round(List.Flatten(i)/1000000000, 2); }
code_block_9 = CodeBlock { "M3"; }
count_2 = List.Count(list=code_block_8)
ofRepeatedItem_2 = List.OfRepeatedItem(item=code_block_9, amount=count_2)
code_block_10 = CodeBlock(FuncValues=code_block_8, FuncValuesUnit=ofRepeatedItem_2)  # same code as code_block_6

# group: <Func 5> Output Manager
reference_output_2 = CodeBlock(ref=value_for_export_to_others) { ref; }
output_2 = CodeBlock(MainOutput=code_block_10, RefOutput_geoColor=createLeanConcrete.GeometryColor) { MainOutput; RefOutput_geoColor; }

# group: <Func 1> Input Manager
value_for_import_from_others_3 = CodeBlock(MainInput=code_block, RefInput=reference_output_2) { MainInput; RefInput; }

# group: <Func 1-1> Excavation by IsoFDN
하부_surface_추출 = Python(IN[0]=value_for_import_from_others_3.RefInput)  # CPython3
# ---------- 하부_surface_추출.python (26 lines) ----------
# Load the Python Standard and DesignScript Libraries
import sys
import clr
import itertools
clr.AddReference('ProtoGeometry')
from Autodesk.DesignScript.Geometry import *

# The inputs to this node will be stored as a list in the IN variables.
dataEnteringNode = IN
input_elements = IN[0]

# Place your code below this line

srfs_input_elements = list(map(lambda x: x.Explode(), input_elements))

#srfs_input_flatten = list(itertools.chain(*srfs_input_elements))

def func_findZ_normalAtParma(srf):
    return srf.NormalAtParameter(0.5,0.5).Z
srfs_below = list(map(lambda y: filter(lambda x: func_findZ_normalAtParma(x) == -1, y), srfs_input_elements))

result = srfs_below


# Assign your output to the OUT variable.
OUT = result
# ----------------------------------------
flatten_2 = List.Flatten(list=하부_surface_추출)
perimeterCurves = Surface.PerimeterCurves(surface=flatten_2)
byJoinedCurves = PolyCurve.ByJoinedCurves(curves=perimeterCurves)
code_block_11 = CodeBlock { _ExcavOffsetBottom: var[]..[] = 300; }
offset = Curve.Offset(curve=byJoinedCurves, distance=code_block_11)
flatten_3 = List.Flatten(list=offset)
levels = Levels("G.L")  # graph input
elevation = Level.Elevation(level=levels)
code_block_12 = CodeBlock { "TargetElements"; }
valueAtKey_3 = DesignScript.Builtin.Dictionary.ValueAtKey(dictionary=value_for_import_from_others_3.MainInput, key=code_block_12)
code_block_13 = CodeBlock { "Elevation at Bottom"; }
getParameterValueByName_2 = Element.GetParameterValueByName(element=valueAtKey_3, parameterName=code_block_13)
린_콘크리트_하부까지의_길이_추출_최하단 = Python(IN[0]=value_for_import_from_others_3.RefInput)  # CPython3
# ---------- 린_콘크리트_하부까지의_길이_추출_최하단.python (22 lines) ----------
# Load the Python Standard and DesignScript Libraries
import sys
import clr
clr.AddReference('ProtoGeometry')
from Autodesk.DesignScript.Geometry import *

# The inputs to this node will be stored as a list in the IN variables.
dataEnteringNode = IN
inputs = IN[0]

# Place your code below this line

def findThickness(i):
    minPt_Z = BoundingBox.ByGeometry(i).MinPoint.Z
    maxPt_Z = BoundingBox.ByGeometry(i).MaxPoint.Z
    result = maxPt_Z - minPt_Z
    return result

thicknessByInput = list(map(findThickness, inputs))

# Assign your output to the OUT variable.
OUT = thicknessByInput
# ----------------------------------------
code_block_14 = CodeBlock(기초하단=getParameterValueByName_2, 린콘크리트하단=린_콘크리트_하부까지의_길이_추출_최하단) { 기초하단-린콘크리트하단; }
sub = elevation - code_block_14
code_block_15 = CodeBlock { 0; }
isNull = Object.IsNull()  # unwired: object
replaceByCondition = Replace(item=sub, replaceWith=code_block_15, condition=isNull)
flatten_4 = List.Flatten(list=replaceByCondition)
translate = Geometry.Translate(geometry=offset, zTranslation=flatten_4)
경사_비율_입력_1_x_for_isofdn = DoubleInput(2)  # graph input
code_block_16 = CodeBlock(ElevationatBottom=flatten_4, 비율=경사_비율_입력_1_x_for_isofdn) { ElevationatBottom/비율; }
offset_2 = Curve.Offset(curve=translate, distance=code_block_16)
flatten_5 = List.Flatten(list=offset_2)
list_create = List.Create(item0=flatten_3, item1=flatten_5)
transpose = List.Transpose(lists=list_create)
byLoft = Solid.ByLoft(crossSections=transpose)
터파기_형상_겹침_해소 = Python(IN[0]=byLoft)  # CPython3
# ---------- 터파기_형상_겹침_해소.python (29 lines) ----------
# Load the Python Standard and DesignScript Libraries
import sys
import clr
clr.AddReference('ProtoGeometry')
from Autodesk.DesignScript.Geometry import *

# The inputs to this node will be stored as a list in the IN variables.
dataEnteringNode = IN
inputs = IN[0]
result = []
# Place your code below this line

for x in range(len(inputs)):
    if x < len(inputs)-1:
        temp = []
        apply = inputs[x]
        for y in range(x,len(inputs)):
            if apply.DoesIntersect(inputs[y]):
                apply = apply.Split(inputs[y])[0]
                temp.append(apply)
            else:
                apply = apply
                temp.append(apply)
        result.append(temp[-1])
    elif x == len(inputs)-1:
        result.append(inputs[x])

# Assign your output to the OUT variable.
OUT = result
# ----------------------------------------
volume_2 = Solid.Volume(solid=터파기_형상_겹침_해소)
code_block_17 = CodeBlock(i=volume_2) { Math.Round(List.Flatten(i)/1000000000, 2); }
code_block_18 = CodeBlock { "M3"; }
count_3 = List.Count(list=code_block_17)
ofRepeatedItem_3 = List.OfRepeatedItem(item=code_block_18, amount=count_3)
code_block_19 = CodeBlock(FuncValues=code_block_17, FuncValuesUnit=ofRepeatedItem_3)  # same code as code_block_6
color_palette = ColorPalette({R: 210, G: 105, B: 30, A: 135})
byGeometryColor = Modifiers.GeometryColor.ByGeometryColor(geometry=터파기_형상_겹침_해소, color=color_palette)
forRefOutput = CodeBlock(MainOutput=code_block_19, geoColor=byGeometryColor, 터파기형상=터파기_형상_겹침_해소)
# ---------- forRefOutput.designscript (5 lines) ----------
{
"MainOutput": MainOutput,
"geoColor": geoColor,
"터파기형상": 터파기형상
};
# ----------------------------------------

# group: <Func 1-2> Excavation by Overall
하부_surface_추출_2 = Python(IN[0]=value_for_import_from_others_3.RefInput)  # CPython3; same code as 하부_surface_추출
flatten_6 = List.Flatten(list=하부_surface_추출_2)
byGeometry = BoundingBox.ByGeometry(geom=flatten_6)
toCuboid = BoundingBox.ToCuboid(boundingBox=byGeometry)
code_block_20 = CodeBlock(i=toCuboid) { [i]; }
하부_surface_추출_3 = Python(IN[0]=code_block_20)  # CPython3; same code as 하부_surface_추출
perimeterCurves_2 = Surface.PerimeterCurves(surface=하부_surface_추출_3)
byJoinedCurves_2 = PolyCurve.ByJoinedCurves(curves=perimeterCurves_2)
code_block_21 = CodeBlock { _ExcavOffsetBottom: var[]..[] = 300; }
offset_3 = Curve.Offset(curve=byJoinedCurves_2, distance=code_block_21)
flatten_7 = List.Flatten(list=offset_3)
levels_2 = Levels("G.L")  # graph input
elevation_2 = Level.Elevation(level=levels_2)
code_block_22 = CodeBlock { "TargetElements"; }
valueAtKey_4 = DesignScript.Builtin.Dictionary.ValueAtKey(dictionary=value_for_import_from_others_3.MainInput, key=code_block_22)
code_block_23 = CodeBlock { "Elevation at Bottom"; }
getParameterValueByName_3 = Element.GetParameterValueByName(element=valueAtKey_4, parameterName=code_block_23)
린_콘크리트_하부까지의_길이_추출_최하단_2 = Python(IN[0]=value_for_import_from_others_3.RefInput)  # CPython3; same code as 린_콘크리트_하부까지의_길이_추출_최하단
code_block_24 = CodeBlock(기초하단=getParameterValueByName_3, 린콘크리트하단=린_콘크리트_하부까지의_길이_추출_최하단_2) { 기초하단-린콘크리트하단; }
uniqueItems = List.UniqueItems(list=code_block_24@L2)
sub_2 = elevation_2 - uniqueItems
code_block_25 = CodeBlock { 0; }
isNull_2 = Object.IsNull()  # unwired: object
replaceByCondition_2 = Replace(item=sub_2, replaceWith=code_block_25, condition=isNull_2)
flatten_8 = List.Flatten(list=replaceByCondition_2)
translate_2 = Geometry.Translate(geometry=offset_3, zTranslation=flatten_8)
경사_비율_입력_1_x_for_overall = DoubleInput(2)  # graph input
code_block_26 = CodeBlock(ElevationatBottom=flatten_8, 비율=경사_비율_입력_1_x_for_overall) { ElevationatBottom/비율; }
offset_4 = Curve.Offset(curve=translate_2, distance=code_block_26)
flatten_9 = List.Flatten(list=offset_4)
list_create_2 = List.Create(item0=flatten_7, item1=flatten_9)
transpose_2 = List.Transpose(lists=list_create_2)
byLoft_2 = Solid.ByLoft(crossSections=transpose_2)
터파기_형상_겹침_해소_2 = Python(IN[0]=byLoft_2)  # CPython3; same code as 터파기_형상_겹침_해소
volume_3 = Solid.Volume(solid=터파기_형상_겹침_해소_2)
code_block_27 = CodeBlock(i=volume_3) { Math.Round(List.Flatten(i)/1000000000, 2); }
code_block_28 = CodeBlock { "M3"; }
count_4 = List.Count(list=code_block_27)
ofRepeatedItem_4 = List.OfRepeatedItem(item=code_block_28, amount=count_4)
code_block_29 = CodeBlock(FuncValues=code_block_27, FuncValuesUnit=ofRepeatedItem_4)  # same code as code_block_6
color_palette_2 = ColorPalette({R: 210, G: 105, B: 30, A: 135})
byGeometryColor_2 = Modifiers.GeometryColor.ByGeometryColor(geometry=터파기_형상_겹침_해소_2, color=color_palette_2)
forRefOutput_2 = CodeBlock(MainOutput=code_block_29, geoColor=byGeometryColor_2, 터파기형상=터파기_형상_겹침_해소_2)  # same code as forRefOutput

# group: 함수 선택
터파기_산출_타입_선택_iso_or_overall = StringInput("iso")  # graph input
code_block_30 = CodeBlock(functionName=터파기_산출_타입_선택_iso_or_overall) { functionName == "iso"? true:false; }
if_ = If(test=code_block_30, true=forRefOutput, false=forRefOutput_2)

# group: <Func 1> Output Manager
code_block_31 = CodeBlock { "MainOutput"; }
valueAtKey_5 = DesignScript.Builtin.Dictionary.ValueAtKey(dictionary=if_, key=code_block_31)
code_block_32 = CodeBlock { "geoColor"; }
valueAtKey_6 = DesignScript.Builtin.Dictionary.ValueAtKey(dictionary=if_, key=code_block_32)
output_3 = CodeBlock(MainOutput=valueAtKey_5, RefOutput_geoColor=valueAtKey_6) { MainOutput; RefOutput_geoColor; }
code_block_33 = CodeBlock { "터파기형상"; }
valueAtKey_7 = DesignScript.Builtin.Dictionary.ValueAtKey(dictionary=if_, key=code_block_33)
reference_output_3 = CodeBlock(터파기형상=valueAtKey_7) { 터파기형상; }

# group: <Func 2> Input Manager
value_for_import_from_others_4 = CodeBlock(MainInput=code_block, RefInput1=reference_output_3, RefInput2=reference_output_2) { MainInput; RefInput1; RefInput2; }

# group: <Func 2> Backfill
value_for_import_from_others_5 = CodeBlock(터파기형상=value_for_import_from_others_4.RefInput1) { 터파기형상; }
flatten_10 = List.Flatten(list=value_for_import_from_others_5)
volume_4 = Solid.Volume(solid=flatten_10)
flatten_11 = List.Flatten(list=value_for_import_from_others_4.RefInput2)
code_block_34 = CodeBlock { "TargetElements"; }
valueAtKey_8 = DesignScript.Builtin.Dictionary.ValueAtKey(dictionary=value_for_import_from_others_4.MainInput, key=code_block_34)
geometry = Element.Geometry(element=valueAtKey_8)
flatten_12 = List.Flatten(list=geometry)
categories = Categories("OST_StructuralColumns")
all_elements_of_category = ElementsOfCategory(Category=categories)
geometry_2 = Element.Geometry(element=all_elements_of_category)
flatten_13 = List.Flatten(list=geometry_2)
doesIntersect = Geometry.DoesIntersect(geometry=flatten_10, other=flatten_13, lacing=CrossProduct)
filterByBoolMask = List.FilterByBoolMask(list=flatten_13, mask=doesIntersect@L2)
flatten_14 = List.Flatten(list=filterByBoolMask.in)
list_create_3 = List.Create(item0=flatten_11, item1=flatten_12, item2=flatten_14)
transpose_3 = List.Transpose(lists=list_create_3)
byUnion = Solid.ByUnion(solids=transpose_3)
volume_5 = Solid.Volume(solid=byUnion)
code_block_35 = CodeBlock(터파기볼륨=volume_4, 콘크리트들볼륨=volume_5) { 터파기볼륨 - 콘크리트들볼륨; }
watch = Watch(code_block_35)
code_block_36 = CodeBlock(i=watch) { Math.Round(List.Flatten(i)/1000000000, 2); }
code_block_37 = CodeBlock { "M3"; }
count_5 = List.Count(list=watch)
ofRepeatedItem_5 = List.OfRepeatedItem(item=code_block_37, amount=count_5)
# note: 터파기 물량ㅈ에서 콘크리트, 린 기둥 물량 빼기
code_block_38 = CodeBlock(FuncValues=code_block_36, FuncValuesUnit=ofRepeatedItem_5)  # same code as code_block_6

# group: <Func 2> Output Manager
output_4 = CodeBlock(MainOutput=code_block_38) { MainOutput; RefOutput_geoColor; }  # unwired: RefOutput_geoColor
reference_output_4 = CodeBlock(콘크리트들볼륨=volume_5) { 콘크리트들볼륨; }

# group: <Func 3> Input Manager
value_for_import_from_others_6 = CodeBlock(MainInput=code_block, RefInput1=reference_output_4) { MainInput; RefInput1; RefInput2; }  # unwired: RefInput2

# group: <Func 3> Disposal (잔토처리 1.2 비율)
watch_2 = Watch(value_for_import_from_others_6.RefInput1)
토량_환산_계수 = DoubleInput(1)  # graph input
code_block_39 = CodeBlock(i=watch_2, 토량환산계수=토량_환산_계수) { Math.Round(List.Flatten(i)/1000000000, 2)*토량환산계수; }
code_block_40 = CodeBlock { "M3"; }
count_6 = List.Count(list=watch_2)
ofRepeatedItem_6 = List.OfRepeatedItem(item=code_block_40, amount=count_6)
# note: 잔토처리
code_block_41 = CodeBlock(FuncValues=code_block_39, FuncValuesUnit=ofRepeatedItem_6)  # same code as code_block_6

# group: <Func 3> Output Manager
output_5 = CodeBlock(MainOutput=code_block_41) { MainOutput; RefOutput_geoColor; }  # unwired: RefOutput_geoColor
reference_output_5 = CodeBlock { ref; }  # unwired: ref

# group: <Func 4> Input Manager
value_for_import_from_others_7 = CodeBlock(MainInput=code_block) { MainInput; RefInput1; RefInput2; }  # unwired: RefInput1, RefInput2

code_block_42 = CodeBlock { 300; 100; }

# group: <Func 4> Base Course
code_block_43 = CodeBlock { "TargetElements"; }
valueAtKey_9 = DesignScript.Builtin.Dictionary.ValueAtKey(dictionary=value_for_import_from_others_7.MainInput, key=code_block_43)
# note: <Func>
createBaseCourseSurfaces = Custom[CreateBaseCourseSurfaces](Element=valueAtKey_9, BaseCourseOffsetBottom=code_block_42.out0, leanThick=code_block_42.out1)  # CreateBaseCourseSurfaces
area = Surface.Area(surface=createBaseCourseSurfaces.Surface)
code_block_44 = CodeBlock(i=area) { Math.Round(List.Flatten(i)/1000000, 2); }
code_block_45 = CodeBlock { "M2"; }
count_7 = List.Count(list=code_block_44)
ofRepeatedItem_7 = List.OfRepeatedItem(item=code_block_45, amount=count_7)
code_block_46 = CodeBlock(FuncValues=code_block_44, FuncValuesUnit=ofRepeatedItem_7)  # same code as code_block_6

# group: <Func 4> Output Manager
output_6 = CodeBlock(MainOutput=code_block_46, RefOutput_geoColor=createBaseCourseSurfaces.GeometryColor) { MainOutput; RefOutput_geoColor; }
reference_output_6 = CodeBlock { ref; }  # unwired: ref

# group: <Func 6> Input Manager
value_for_import_from_others_8 = CodeBlock(MainInput=code_block) { MainInput; RefInput1; RefInput2; }  # unwired: RefInput1, RefInput2

# group: <Func 6> Form Works
code_block_47 = CodeBlock { "TargetElements"; }
valueAtKey_10 = DesignScript.Builtin.Dictionary.ValueAtKey(dictionary=value_for_import_from_others_8.MainInput, key=code_block_47)
# note: <Func>
extractSideFacesOfElement = Custom[ExtractSideFacesOfElement](Element=valueAtKey_10)  # ExtractSideFacesOfElement
area_2 = Surface.Area(surface=extractSideFacesOfElement.Surface)
sum = Math.Sum(values=area_2)
code_block_48 = CodeBlock(i=sum) { Math.Round(List.Flatten(i)/1000000, 2); }
code_block_49 = CodeBlock { "M2"; }
count_8 = List.Count(list=code_block_48)
ofRepeatedItem_8 = List.OfRepeatedItem(item=code_block_49, amount=count_8)
code_block_50 = CodeBlock(FuncValues=code_block_48, FuncValuesUnit=ofRepeatedItem_8)  # same code as code_block_6

# group: <Func 6> Output Manager
output_7 = CodeBlock(MainOutput=code_block_50, RefOutput_geoColor=extractSideFacesOfElement.GeometryColor) { MainOutput; RefOutput_geoColor; }
reference_output_7 = CodeBlock { ref; }  # unwired: ref

# group: <Func 7> Input Manager
value_for_import_from_others_9 = CodeBlock(MainInput=code_block) { MainInput; RefInput1; RefInput2; factor; }  # unwired: RefInput1, RefInput2, factor

# group: <Func 7> Rebar
code_block_51 = CodeBlock { "TargetElements"; }
valueAtKey_11 = DesignScript.Builtin.Dictionary.ValueAtKey(dictionary=value_for_import_from_others_9.MainInput, key=code_block_51)
code_block_52 = CodeBlock { "Volume"; }
# note: <Func>
getParameterValueByName_4 = Element.GetParameterValueByName(element=valueAtKey_11, parameterName=code_block_52)
독립기초_철근비 = DoubleInput(0)  # graph input
mul = getParameterValueByName_4 * 독립기초_철근비
code_block_53 = CodeBlock(i=mul) { Math.Round(List.Flatten(i)/1, 2); }
code_block_54 = CodeBlock { "TON"; }
count_9 = List.Count(list=code_block_53)
ofRepeatedItem_9 = List.OfRepeatedItem(item=code_block_54, amount=count_9)
code_block_55 = CodeBlock(FuncValues=code_block_53, FuncValuesUnit=ofRepeatedItem_9)  # same code as code_block_6

# group: <Func 7> Output Manager
output_8 = CodeBlock(MainOutput=code_block_55) { MainOutput; RefOutput_geoColor; }  # unwired: RefOutput_geoColor
reference_output_8 = CodeBlock { ref; }  # unwired: ref

# group: <Func 8> Input Manager
value_for_import_from_others_10 = CodeBlock(MainInput=code_block) { MainInput; RefInput1; RefInput2; }  # unwired: RefInput1, RefInput2

# group: <Func 8> Sheet Memebrane
code_block_56 = CodeBlock { "TargetElements"; }
valueAtKey_12 = DesignScript.Builtin.Dictionary.ValueAtKey(dictionary=value_for_import_from_others_10.MainInput, key=code_block_56)
# note: <Func>
createLeanConcrete_2 = Custom[CreateLeanConcrete](Element=valueAtKey_12)
area_3 = Surface.Area(surface=createLeanConcrete_2.Surface)
code_block_57 = CodeBlock(i=area_3) { Math.Round(List.Flatten(i)/1000000, 2); }
code_block_58 = CodeBlock { "M2"; }
count_10 = List.Count(list=code_block_57)
ofRepeatedItem_10 = List.OfRepeatedItem(item=code_block_58, amount=count_10)
code_block_59 = CodeBlock(FuncValues=code_block_57, FuncValuesUnit=ofRepeatedItem_10)  # same code as code_block_6

# group: <Func 8> Output Manager
output_9 = CodeBlock(MainOutput=code_block_59) { MainOutput; RefOutput_geoColor; }  # unwired: RefOutput_geoColor
reference_output_9 = CodeBlock { ref; }  # unwired: ref

# group: <Func 9> Input Manager
value_for_import_from_others_11 = CodeBlock(MainInput=code_block) { MainInput; RefInput1; RefInput2; }  # unwired: RefInput1, RefInput2

# group: <Func 9> Membrane Protection Board (측면 + 상부면 중 pedestal 점유면적 제외)
code_block_60 = CodeBlock { "TargetElements"; }
# note: <Func>
valueAtKey_13 = DesignScript.Builtin.Dictionary.ValueAtKey(dictionary=value_for_import_from_others_11.MainInput, key=code_block_60)
code_block_61 = CodeBlock(Element=valueAtKey_13) { _Element; }
extractUpperFacesOfElement = Custom[ExtractUpperFacesOfElement](Element=code_block_61)  # ExtractUpperFacesOfElement
flatten_15 = List.Flatten(list=extractUpperFacesOfElement.Surface)
getJoinedElements = Element.GetJoinedElements(element=code_block_61)
flatten_16 = List.Flatten(list=getJoinedElements)
extractBelowFacesOfElement = Custom[ExtractBelowFacesOfElement](Element=flatten_16)  # ExtractBelowFacesOfElement
flatten_17 = List.Flatten(list=extractBelowFacesOfElement.Surface)
doesIntersect_2 = Geometry.DoesIntersect(geometry=flatten_17, other=flatten_15, lacing=CrossProduct)
code_block_62 = CodeBlock { true; }
allIndicesOf = List.AllIndicesOf(list=doesIntersect_2@L2, item=code_block_62)
flatten_18 = List.Flatten(list=allIndicesOf)
groupByKey = List.GroupByKey(list=flatten_17, keys=flatten_18)
difference = Surface.Difference(surface=flatten_15, others=groupByKey.groups)
extractSideFacesOfElement_2 = Custom[ExtractSideFacesOfElement](Element=code_block_61)
addItemToFront = List.AddItemToFront(item=difference@L1, list=extractSideFacesOfElement_2.Surface@L2)
area_4 = Surface.Area(surface=addItemToFront)
sum_2 = Math.Sum(values=area_4)
code_block_63 = CodeBlock(i=sum_2) { Math.Round(List.Flatten(i)/1000000, 2); }
code_block_64 = CodeBlock { "M2"; }
count_11 = List.Count(list=code_block_63)
ofRepeatedItem_11 = List.OfRepeatedItem(item=code_block_64, amount=count_11)
code_block_65 = CodeBlock(FuncValues=code_block_63, FuncValuesUnit=ofRepeatedItem_11)  # same code as code_block_6
color_palette_3 = ColorPalette({R: 30, G: 144, B: 255, A: 129})
byGeometryColor_3 = Modifiers.GeometryColor.ByGeometryColor(geometry=addItemToFront, color=color_palette_3)

# group: <Func 9> Output Manager
output_10 = CodeBlock(MainOutput=code_block_65, RefOutput_geoColor=byGeometryColor_3) { MainOutput; RefOutput_geoColor; }
reference_output_10 = CodeBlock { ref; }  # unwired: ref

join = List.Join(list0=output.MainOutput, list1=output_3.MainOutput, list2=output_4.MainOutput, list3=output_5.MainOutput, list4=output_6.MainOutput, list5=output_2.MainOutput, list6=output_7.MainOutput, list7=output_8.MainOutput, list8=output_9.MainOutput, list9=output_10.MainOutput)

# group: TargetWMunique + Data Sending
code_block_66 = CodeBlock(InputDic2=join) { _InputDic2; }
count_12 = List.Count(list=code_block_66)
code_block_67 = CodeBlock(InputDic1=code_block) { _InputDic1; }
code_block_68 = CodeBlock { "TargetWMunique"; }
valueAtKey_14 = DesignScript.Builtin.Dictionary.ValueAtKey(dictionary=code_block_67, key=code_block_68)
watch_3 = Watch(valueAtKey_14)
count_13 = List.Count(list=watch_3)
eq = count_12 == count_13
organizeFuncValuesAndWorkMasterAsDiction = Custom[OrganizeFuncValuesAndWorkMasterAsDictionary](InputDic1=code_block_67, InputDic2=code_block_66)  # Organize FuncValues and WorkMaster As Dictionary
watch_4 = Watch()  # unwired: arg0
if_2 = If(test=eq, true=organizeFuncValuesAndWorkMasterAsDiction, false=watch_4)

# group: 데이터 취합 및 Row 방향 정렬
code_block_69 = CodeBlock(InputDic=if_2) { _InputDic; }
code_block_70 = CodeBlock { "TrTargetFamilyCode"; }
valueAtKey_15 = DesignScript.Builtin.Dictionary.ValueAtKey(dictionary=code_block_69, key=code_block_70)
watch_5 = Watch(valueAtKey_15)
flatten_19 = List.Flatten(list=watch_5)
code_block_71 = CodeBlock { "WMforTargetElements"; }
valueAtKey_16 = DesignScript.Builtin.Dictionary.ValueAtKey(dictionary=code_block_69, key=code_block_71)
watch_6 = Watch(valueAtKey_16)
flatten_20 = List.Flatten(list=watch_6)
code_block_72 = CodeBlock { "TargetFuncValues"; }
valueAtKey_17 = DesignScript.Builtin.Dictionary.ValueAtKey(dictionary=code_block_69, key=code_block_72)
watch_7 = Watch(valueAtKey_17)
flatten_21 = List.Flatten(list=watch_7)
code_block_73 = CodeBlock { "TargetFuncValuesUnit"; }
valueAtKey_18 = DesignScript.Builtin.Dictionary.ValueAtKey(dictionary=code_block_69, key=code_block_73)
watch_8 = Watch(valueAtKey_18)
flatten_22 = List.Flatten(list=watch_8)
list_create_4 = List.Create(item0=flatten_19, item1=flatten_20, item2=flatten_21, item3=flatten_22)
transpose_4 = List.Transpose(lists=list_create_4)

code_block_74 = CodeBlock { i; }  # unwired: i

# group: Input Manager
value_for_import_from_others_12 = CodeBlock(MainInput=code_block_74) { MainInput; RefInput1; RefInput2; }  # unwired: RefInput1, RefInput2

# group: <Func 9>Lean Concrete
code_block_75 = CodeBlock { "TargetElements"; }
valueAtKey_19 = DesignScript.Builtin.Dictionary.ValueAtKey(dictionary=value_for_import_from_others_12.MainInput, key=code_block_75)
code_block_76 = CodeBlock { 0; 100; }
# note: <Func>
createLeanConcrete_3 = Custom[CreateLeanConcrete](Element=valueAtKey_19, leanOffset=code_block_76.out0, leanThick=code_block_76.out1)
volume_6 = Solid.Volume(solid=createLeanConcrete_3.Solid)
code_block_77 = CodeBlock(i=volume_6) { Math.Round(List.Flatten(i)/1000000000, 2); }
code_block_78 = CodeBlock { "M3"; }
count_14 = List.Count(list=code_block_77)
ofRepeatedItem_12 = List.OfRepeatedItem(item=code_block_78, amount=count_14)
code_block_79 = CodeBlock(FuncValues=code_block_77, FuncValuesUnit=ofRepeatedItem_12)  # same code as code_block_6

# group: Output Manager
reference_output_11 = CodeBlock(ref=createLeanConcrete_3.Solid) { ref; }
output_11 = CodeBlock(MainOutput=code_block_79, RefOutput_geoColor=createLeanConcrete_3.Solid) { MainOutput; RefOutput_geoColor; }

# group: Input Manager
value_for_import_from_others_13 = CodeBlock(MainInput=code_block_74, RefInput1=reference_output_11) { MainInput; RefInput1; RefInput2; }  # unwired: RefInput2

# group: <Func 4> Excavation (SOG 한정)
flatten_23 = List.Flatten(list=value_for_import_from_others_13.RefInput1)
하부_surface_추출_4 = Python(IN[0]=flatten_23)  # CPython3; same code as 하부_surface_추출
flatten_24 = List.Flatten(list=하부_surface_추출_4)
perimeterCurves_3 = Surface.PerimeterCurves(surface=flatten_24)
byJoinedCurves_3 = PolyCurve.ByJoinedCurves(curves=perimeterCurves_3)
code_block_80 = CodeBlock { _ExcavOffsetBottom: var[]..[] = 300; }
offset_5 = Curve.Offset(curve=byJoinedCurves_3, distance=code_block_80)
flatten_25 = List.Flatten(list=offset_5)
levels_3 = Levels("G.L")  # graph input
elevation_3 = Level.Elevation(level=levels_3)
code_block_81 = CodeBlock { "TargetElements"; }
valueAtKey_20 = DesignScript.Builtin.Dictionary.ValueAtKey(dictionary=value_for_import_from_others_13.MainInput, key=code_block_81)
code_block_82 = CodeBlock { "Elevation at Bottom"; }
getParameterValueByName_5 = Element.GetParameterValueByName(element=valueAtKey_20, parameterName=code_block_82)
린_콘크리트_하부까지의_길이_추출_최하단_3 = Python(IN[0]=value_for_import_from_others_13.RefInput1)  # CPython3; same code as 린_콘크리트_하부까지의_길이_추출_최하단
code_block_83 = CodeBlock(기초하단=getParameterValueByName_5, 린콘크리트하단=린_콘크리트_하부까지의_길이_추출_최하단_3) { 기초하단-린콘크리트하단; }
sub_3 = elevation_3 - code_block_83
flatten_26 = List.Flatten(list=sub_3)
translate_3 = Geometry.Translate(geometry=offset_5, zTranslation=flatten_26)
경사_비율_입력_1_x_for_isofdn_2 = DoubleInput(2)  # graph input
code_block_84 = CodeBlock(ElevationatBottom=flatten_26, 비율=경사_비율_입력_1_x_for_isofdn_2) { ElevationatBottom/비율; }
offset_6 = Curve.Offset(curve=translate_3, distance=code_block_84)
flatten_27 = List.Flatten(list=offset_6)
list_create_5 = List.Create(item0=flatten_25, item1=flatten_27)
transpose_5 = List.Transpose(lists=list_create_5)
byLoft_3 = Solid.ByLoft(crossSections=transpose_5)
터파기_형상_겹침_해소_3 = Python(IN[0]=byLoft_3)  # CPython3; same code as 터파기_형상_겹침_해소
code_block_85 = CodeBlock(i=sub_3) { i<0?true:false; }
code_block_86 = CodeBlock { 0; }
volume_7 = Solid.Volume(solid=터파기_형상_겹침_해소_3)
code_block_87 = CodeBlock(i=volume_7) { Math.Round(List.Flatten(i)/1000000000, 2); }
if_3 = If(test=code_block_85, true=code_block_86, false=code_block_87)
code_block_88 = CodeBlock { "M3"; }
count_15 = List.Count(list=code_block_87)
ofRepeatedItem_13 = List.OfRepeatedItem(item=code_block_88, amount=count_15)
code_block_89 = CodeBlock(FuncValues=if_3, FuncValuesUnit=ofRepeatedItem_13)  # same code as code_block_6
color_palette_4 = ColorPalette({R: 210, G: 105, B: 30, A: 135})
byGeometryColor_4 = Modifiers.GeometryColor.ByGeometryColor(geometry=터파기_형상_겹침_해소_3, color=color_palette_4)
forRefOutput_3 = CodeBlock(MainOutput=code_block_89, geoColor=byGeometryColor_4, 터파기형상=터파기_형상_겹침_해소_3)  # same code as forRefOutput

# group: Output Manager
reference_output_12 = CodeBlock(ref=터파기_형상_겹침_해소_3, ref2=if_3) { ref; ref2; }
output_12 = CodeBlock(MainOutput=forRefOutput_3, RefOutput_geoColor=byGeometryColor_4) { MainOutput; RefOutput_geoColor; }

# group: Input Manager
value_for_import_from_others_14 = CodeBlock(MainInput=code_block_74, RefInput1=reference_output_12.ref2) { MainInput; RefInput1; RefInput2; }  # unwired: RefInput2

# group: <Func 6>Disposal
code_block_90 = CodeBlock { "TargetElements"; }
valueAtKey_21 = DesignScript.Builtin.Dictionary.ValueAtKey(dictionary=value_for_import_from_others_14.MainInput, key=code_block_90)
count_16 = List.Count(list=valueAtKey_21@L1)
code_block_91 = CodeBlock(i=value_for_import_from_others_14.RefInput1) { i==0?true:false; }
code_block_92 = CodeBlock { 0; }
# note: <Func>
if_4 = If(test=code_block_91, true=code_block_92, false=value_for_import_from_others_14.RefInput1)
code_block_93 = CodeBlock(i=if_4) { Math.Round(List.Flatten(i)/1000000000, 2); }
code_block_94 = CodeBlock { "M3"; }
count_17 = List.Count(list=code_block_93)
ofRepeatedItem_14 = List.OfRepeatedItem(item=code_block_94, amount=count_17)
code_block_95 = CodeBlock(FuncValues=code_block_93, FuncValuesUnit=ofRepeatedItem_14)  # same code as code_block_6

# group: <Func 1> Visual Manager
visual_켜기_끄기 = BoolSelector(true)
visual_manager = Python(IN[0]=output_3.RefOutput_geoColor, IN[1]=visual_켜기_끄기)  # CPython3
# ---------- visual_manager.python (18 lines) ----------
# Load the Python Standard and DesignScript Libraries
import sys
import clr
clr.AddReference('ProtoGeometry')
from Autodesk.DesignScript.Geometry import *

# The inputs to this node will be stored as a list in the IN variables.
dataEnteringNode = IN
geoColors = IN[0]
blnForVisual = IN[1]

# Place your code below this line
if blnForVisual == True:
    result = geoColors
else:
    result = 0
# Assign your output to the OUT variable.
OUT = result
# ----------------------------------------

# group: <Func 4> Visual Manager
visual_켜기_끄기_2 = BoolSelector(true)
visual_manager_2 = Python(IN[0]=output_6.RefOutput_geoColor, IN[1]=visual_켜기_끄기_2)  # CPython3; same code as visual_manager

# group: <Func 5> Visual Manager
visual_켜기_끄기_3 = BoolSelector(true)
visual_manager_3 = Python(IN[0]=output_2.RefOutput_geoColor, IN[1]=visual_켜기_끄기_3)  # CPython3; same code as visual_manager

# group: <Func 6> Visual Manager
visual_켜기_끄기_4 = BoolSelector(true)
visual_manager_4 = Python(IN[0]=output_7.RefOutput_geoColor, IN[1]=visual_켜기_끄기_4)  # CPython3; same code as visual_manager

# group: <Func 6> Visual Manager
visual_켜기_끄기_5 = BoolSelector(true)
visual_manager_5 = Python(IN[0]=output_10.RefOutput_geoColor, IN[1]=visual_켜기_끄기_5)  # CPython3; same code as visual_manager

# group: Input Manager
value_for_import_from_others_15 = CodeBlock(MainInput=code_block_74) { MainInput; RefInput1; RefInput2; }  # unwired: RefInput1, RefInput2

# group: <Func 0> Hardner Finish (상부면)
code_block_96 = CodeBlock { "TargetElements"; }
# note: <Func>
valueAtKey_22 = DesignScript.Builtin.Dictionary.ValueAtKey(dictionary=value_for_import_from_others_15.MainInput, key=code_block_96)
flatten_28 = List.Flatten(list=valueAtKey_22)
# note: 일반화 여지가 있음
# (형상처리구간 + 물량계산 + 데이터 매칭)
extractUpperFacesOfElement_2 = Custom[ExtractUpperFacesOfElement](Element=flatten_28)
area_5 = Surface.Area(surface=extractUpperFacesOfElement_2.Surface)
sum_3 = Math.Sum(values=area_5)
code_block_97 = CodeBlock(i=sum_3) { Math.Round(List.Flatten(i)/1000000, 2); }
code_block_98 = CodeBlock { "M2"; }
count_18 = List.Count(list=code_block_97)
ofRepeatedItem_15 = List.OfRepeatedItem(item=code_block_98, amount=count_18)
code_block_99 = CodeBlock(FuncValues=code_block_97, FuncValuesUnit=ofRepeatedItem_15)  # same code as code_block_6
color_palette_5 = ColorPalette({R: 30, G: 144, B: 255, A: 129})
byGeometryColor_5 = Modifiers.GeometryColor.ByGeometryColor(geometry=extractUpperFacesOfElement_2.Surface, color=color_palette_5)

# group: Output Manager
output_13 = CodeBlock(MainOutput=code_block_99, RefOutput_geoColor=byGeometryColor_5) { MainOutput; RefOutput_geoColor; }
reference_output_13 = CodeBlock { ref; }  # unwired: ref

# group: <Func 6> Visual Manager
visual_켜기_끄기_6 = BoolSelector(false)
visual_manager_6 = Python(IN[0]=output_13.RefOutput_geoColor, IN[1]=visual_켜기_끄기_6)  # CPython3; same code as visual_manager

# group: Visual Manager
visual_켜기_끄기_7 = BoolSelector(false)
visual_manager_7 = Python(IN[0]=output_12.RefOutput_geoColor, IN[1]=visual_켜기_끄기_7)  # CPython3; same code as visual_manager

# group: Input Manager
value_for_import_from_others_16 = CodeBlock(MainInput=code_block_74) { MainInput; RefInput1; RefInput2; }  # unwired: RefInput1, RefInput2

# group: <Func 1> Structural Concrete
code_block_100 = CodeBlock { "TargetElements"; }
valueAtKey_23 = DesignScript.Builtin.Dictionary.ValueAtKey(dictionary=value_for_import_from_others_16.MainInput, key=code_block_100)
# note: <Func>
geometry_3 = Element.Geometry(element=valueAtKey_23)
volume_8 = Solid.Volume(solid=geometry_3)
code_block_101 = CodeBlock(i=volume_8) { Math.Round(List.Flatten(i)/1000000000,2); }
code_block_102 = CodeBlock { "M3"; }
count_19 = List.Count(list=code_block_101)
ofRepeatedItem_16 = List.OfRepeatedItem(item=code_block_102, amount=count_19)
code_block_103 = CodeBlock(FuncValues=code_block_101, FuncValuesUnit=ofRepeatedItem_16)  # same code as code_block_6

# group: Output Manager
output_14 = CodeBlock(MainOutput=code_block_103) { MainOutput; RefOutput_geoColor; }  # unwired: RefOutput_geoColor
reference_output_14 = CodeBlock(ref=geometry_3) { ref; }

# group: Input Manager
value_for_import_from_others_17 = CodeBlock(MainInput=code_block_74) { MainInput; RefInput1; RefInput2; }  # unwired: RefInput1, RefInput2

# group: <Func 2> Form Works (Ground Slab 거푸집 필요X)
code_block_104 = CodeBlock { "TargetElements"; }
valueAtKey_24 = DesignScript.Builtin.Dictionary.ValueAtKey(dictionary=value_for_import_from_others_17.MainInput, key=code_block_104)
code_block_105 = CodeBlock { "Volume"; }
# note: <Func>
getParameterValueByName_6 = Element.GetParameterValueByName(element=valueAtKey_24, parameterName=code_block_105)
code_block_106 = CodeBlock(i=getParameterValueByName_6) { Math.Round(List.Flatten(i)/10000000,2); }
code_block_107 = CodeBlock { "M3"; }
count_20 = List.Count(list=code_block_106)
ofRepeatedItem_17 = List.OfRepeatedItem(item=code_block_107, amount=count_20)
code_block_108 = CodeBlock(FuncValues=code_block_106, FuncValuesUnit=ofRepeatedItem_17)  # same code as code_block_6

# group: Output Manager
output_15 = CodeBlock(MainOutput=code_block_108) { MainOutput; RefOutput_geoColor; }  # unwired: RefOutput_geoColor
reference_output_15 = CodeBlock { ref; }  # unwired: ref

# group: Input Manager
value_for_import_from_others_18 = CodeBlock(MainInput=code_block_74) { MainInput; RefInput1; RefInput2; }  # unwired: RefInput1, RefInput2

# group: <Func 3> PE Sheet
code_block_109 = CodeBlock { "TargetElements"; }
valueAtKey_25 = DesignScript.Builtin.Dictionary.ValueAtKey(dictionary=value_for_import_from_others_18.MainInput, key=code_block_109)
# note: <Func>
createLeanConcrete_4 = Custom[CreateLeanConcrete](Element=valueAtKey_25)
area_6 = Surface.Area(surface=createLeanConcrete_4.Surface)
code_block_110 = CodeBlock(i=area_6) { Math.Round(List.Flatten(i)/1000000, 2); }
code_block_111 = CodeBlock { "M2"; }
count_21 = List.Count(list=code_block_110)
ofRepeatedItem_18 = List.OfRepeatedItem(item=code_block_111, amount=count_21)
code_block_112 = CodeBlock(FuncValues=code_block_110, FuncValuesUnit=ofRepeatedItem_18)  # same code as code_block_6

# group: Output Manager
output_16 = CodeBlock(MainOutput=code_block_112) { MainOutput; RefOutput_geoColor; }  # unwired: RefOutput_geoColor
reference_output_16 = CodeBlock { ref; }  # unwired: ref

# group: Input Manager
value_for_import_from_others_19 = CodeBlock(MainInput=code_block_74, RefInput1=reference_output_11, RefInput2=reference_output_12.ref, RefInput3=reference_output_14) { MainInput; RefInput1; RefInput2; RefInput3; }

# group: <Func 2> Backfill
value_for_import_from_others_20 = CodeBlock(터파기형상=value_for_import_from_others_19.RefInput2) { 터파기형상; }
flatten_29 = List.Flatten(list=value_for_import_from_others_20)
volume_9 = Solid.Volume(solid=flatten_29)
watch_9 = Watch(volume_9)
code_block_113 = CodeBlock(i=watch_9) { Math.Round(List.Flatten(i)/1000000000, 2); }
code_block_114 = CodeBlock { "M3"; }
count_22 = List.Count(list=watch_9)
ofRepeatedItem_19 = List.OfRepeatedItem(item=code_block_114, amount=count_22)
# note: 터파기 물량ㅈ에서 콘크리트, 린 기둥 물량 빼기
code_block_115 = CodeBlock(FuncValues=code_block_113, FuncValuesUnit=ofRepeatedItem_19)  # same code as code_block_6
value_for_import_from_others_21 = CodeBlock(슬라브형상=value_for_import_from_others_19.RefInput3) { 슬라브형상; }
flatten_30 = List.Flatten(list=value_for_import_from_others_21)
doesIntersect_3 = Geometry.DoesIntersect(geometry=flatten_29, other=flatten_30, lacing=CrossProduct)
filterByBoolMask_2 = List.FilterByBoolMask(list=flatten_30, mask=doesIntersect_3@L2)
flatten_31 = List.Flatten(list=filterByBoolMask_2.in)

# group: Output Manager
output_17 = CodeBlock(MainOutput=code_block_115) { MainOutput; RefOutput_geoColor; }  # unwired: RefOutput_geoColor
reference_output_17 = CodeBlock { ref; }  # unwired: ref

# group: Output Manager
output_18 = CodeBlock(MainOutput=code_block_95) { MainOutput; RefOutput_geoColor; }  # unwired: RefOutput_geoColor
reference_output_18 = CodeBlock { ref; }  # unwired: ref

# group: Input Manager
value_for_import_from_others_22 = CodeBlock(MainInput=code_block_74) { MainInput; RefInput1; RefInput2; }  # unwired: RefInput1, RefInput2

# group: <Func 7>Base Course
code_block_116 = CodeBlock { "TargetElements"; }
valueAtKey_26 = DesignScript.Builtin.Dictionary.ValueAtKey(dictionary=value_for_import_from_others_22.MainInput, key=code_block_116)
code_block_117 = CodeBlock { 300; 100; }
# note: <Func>
createBaseCourseSurfaces_2 = Custom[CreateBaseCourseSurfaces](Element=valueAtKey_26, BaseCourseOffsetBottom=code_block_117.out0, leanThick=code_block_117.out1)
area_7 = Surface.Area(surface=createBaseCourseSurfaces_2.Surface)
code_block_118 = CodeBlock(i=area_7) { Math.Round(List.Flatten(i)/1000000, 2); }
code_block_119 = CodeBlock { "M2"; }
count_23 = List.Count(list=code_block_118)
ofRepeatedItem_20 = List.OfRepeatedItem(item=code_block_119, amount=count_23)
code_block_120 = CodeBlock(FuncValues=code_block_118, FuncValuesUnit=ofRepeatedItem_20)  # same code as code_block_6

# group: Output Manager
output_19 = CodeBlock(MainOutput=code_block_120) { MainOutput; RefOutput_geoColor; }  # unwired: RefOutput_geoColor
reference_output_19 = CodeBlock(ref=createBaseCourseSurfaces_2.Surface) { ref; }

# group: Input Manager
value_for_import_from_others_23 = CodeBlock(MainInput=code_block_74, RefInput1=reference_output_19) { MainInput; RefInput1; RefInput2; }  # unwired: RefInput2

# group: <Func 8>Crushed Stone
code_block_121 = CodeBlock { "TargetElements"; }
valueAtKey_27 = DesignScript.Builtin.Dictionary.ValueAtKey(dictionary=value_for_import_from_others_23.MainInput, key=code_block_121)
# note: <Func>
code_block_122 = CodeBlock { 300; 100; }
createBaseCourseSurfaces_3 = Custom[CreateBaseCourseSurfaces](Element=valueAtKey_27, BaseCourseOffsetBottom=code_block_122.out0, leanThick=code_block_122.out1)
boolean = BoolSelector(false)
thicken = Surface.Thicken(surface=createBaseCourseSurfaces_3.Surface, thickness=code_block_122.out0, both_sides=boolean)
volume_10 = Solid.Volume(solid=thicken)
code_block_123 = CodeBlock(i=volume_10) { Math.Round(List.Flatten(i)/1000000000, 2); }
code_block_124 = CodeBlock { "M3"; }
count_24 = List.Count(list=code_block_123)
ofRepeatedItem_21 = List.OfRepeatedItem(item=code_block_124, amount=count_24)
code_block_125 = CodeBlock(FuncValues=code_block_123, FuncValuesUnit=ofRepeatedItem_21)  # same code as code_block_6

# group: Output Manager
output_20 = CodeBlock(MainOutput=code_block_125) { MainOutput; RefOutput_geoColor; }  # unwired: RefOutput_geoColor
reference_output_20 = CodeBlock { ref; }  # unwired: ref

# group: Input Manager
value_for_import_from_others_24 = CodeBlock(MainInput=code_block_74) { MainInput; RefInput1; RefInput2; }  # unwired: RefInput1, RefInput2

# group: <Func 10>Rebar Work
code_block_126 = CodeBlock { "TargetElements"; }
valueAtKey_28 = DesignScript.Builtin.Dictionary.ValueAtKey(dictionary=value_for_import_from_others_24.MainInput, key=code_block_126)
code_block_127 = CodeBlock { "Volume"; }
# note: <Func>
getParameterValueByName_7 = Element.GetParameterValueByName(element=valueAtKey_28, parameterName=code_block_127)
sog_철근비 = DoubleInput(0)  # graph input
mul_2 = getParameterValueByName_7 * sog_철근비
code_block_128 = CodeBlock(i=mul_2) { Math.Round(List.Flatten(i)/1, 2); }
code_block_129 = CodeBlock { "TON"; }
count_25 = List.Count(list=code_block_128)
ofRepeatedItem_22 = List.OfRepeatedItem(item=code_block_129, amount=count_25)
code_block_130 = CodeBlock(FuncValues=code_block_128, FuncValuesUnit=ofRepeatedItem_22)  # same code as code_block_6

# group: Output Manager
output_21 = CodeBlock(MainOutput=code_block_130) { MainOutput; RefOutput_geoColor; }  # unwired: RefOutput_geoColor
reference_output_21 = CodeBlock { ref; }  # unwired: ref

join_2 = List.Join(list0=output_13.MainOutput, list1=output_14.MainOutput, list2=output_15.MainOutput, list3=output_16.MainOutput, list4=output_12.MainOutput, list5=output_17.MainOutput, list6=output_18.MainOutput, list7=output_19.MainOutput, list8=output_20.MainOutput, list9=output_11.MainOutput, list10=output_21.MainOutput)
watch_10 = Watch(output_12.MainOutput)
code_block_131 = CodeBlock { i; }  # unwired: i
code_block_132 = CodeBlock(i=code_block_131) { i; }

# group: Input Manager
value_for_import_from_others_25 = CodeBlock(MainInput=code_block_132) { MainInput; RefInput1; RefInput2; }  # unwired: RefInput1, RefInput2

# group: <Func 9>Lean Concrete
code_block_133 = CodeBlock { "TargetElements"; }
valueAtKey_29 = DesignScript.Builtin.Dictionary.ValueAtKey(dictionary=value_for_import_from_others_25.MainInput, key=code_block_133)
code_block_134 = CodeBlock { 0; 100; }
# note: <Func>
createLeanConcrete_5 = Custom[CreateLeanConcrete](Element=valueAtKey_29, leanOffset=code_block_134.out0, leanThick=code_block_134.out1)
volume_11 = Solid.Volume(solid=createLeanConcrete_5.Solid)
code_block_135 = CodeBlock(i=volume_11) { Math.Round(List.Flatten(i)/1000000000, 2); }
code_block_136 = CodeBlock { "M3"; }
count_26 = List.Count(list=code_block_135)
ofRepeatedItem_23 = List.OfRepeatedItem(item=code_block_136, amount=count_26)
code_block_137 = CodeBlock(FuncValues=code_block_135, FuncValuesUnit=ofRepeatedItem_23)  # same code as code_block_6

# group: Output Manager
reference_output_22 = CodeBlock(ref=createLeanConcrete_5.Solid) { ref; }
output_22 = CodeBlock(MainOutput=code_block_137, RefOutput_geoColor=createLeanConcrete_5.Solid) { MainOutput; RefOutput_geoColor; }

# group: Input Manager
value_for_import_from_others_26 = CodeBlock(MainInput=code_block_132, RefInput1=reference_output_22) { MainInput; RefInput1; RefInput2; }  # unwired: RefInput2

# group: <Func 4> Excavation (SOG 한정)
levels_4 = Levels("G.L")  # graph input
elevation_4 = Level.Elevation(level=levels_4)
code_block_138 = CodeBlock { "TargetElements"; }
valueAtKey_30 = DesignScript.Builtin.Dictionary.ValueAtKey(dictionary=value_for_import_from_others_26.MainInput, key=code_block_138)
code_block_139 = CodeBlock { "Elevation at Bottom"; }
getParameterValueByName_8 = Element.GetParameterValueByName(element=valueAtKey_30, parameterName=code_block_139)
린_콘크리트_하부까지의_길이_추출_최하단_4 = Python(IN[0]=value_for_import_from_others_26.RefInput1)  # CPython3; same code as 린_콘크리트_하부까지의_길이_추출_최하단
code_block_140 = CodeBlock(기초하단=getParameterValueByName_8, 린콘크리트하단=린_콘크리트_하부까지의_길이_추출_최하단_4) { 기초하단-린콘크리트하단; }
sub_4 = elevation_4 - code_block_140
code_block_141 = CodeBlock(i=sub_4) { i<0?true:false; }
code_block_142 = CodeBlock { 0; }
flatten_32 = List.Flatten(list=value_for_import_from_others_26.RefInput1)
하부_surface_추출_5 = Python(IN[0]=flatten_32)  # CPython3; same code as 하부_surface_추출
flatten_33 = List.Flatten(list=하부_surface_추출_5)
perimeterCurves_4 = Surface.PerimeterCurves(surface=flatten_33)
byJoinedCurves_4 = PolyCurve.ByJoinedCurves(curves=perimeterCurves_4)
code_block_143 = CodeBlock { _ExcavOffsetBottom: var[]..[] = 300; }
offset_7 = Curve.Offset(curve=byJoinedCurves_4, distance=code_block_143)
flatten_34 = List.Flatten(list=offset_7)
flatten_35 = List.Flatten(list=sub_4)
translate_4 = Geometry.Translate(geometry=offset_7, zTranslation=flatten_35)
경사_비율_입력_1_x_for_isofdn_3 = DoubleInput(2)  # graph input
code_block_144 = CodeBlock(ElevationatBottom=flatten_35, 비율=경사_비율_입력_1_x_for_isofdn_3) { ElevationatBottom/비율; }
offset_8 = Curve.Offset(curve=translate_4, distance=code_block_144)
flatten_36 = List.Flatten(list=offset_8)
list_create_6 = List.Create(item0=flatten_34, item1=flatten_36)
transpose_6 = List.Transpose(lists=list_create_6)
byLoft_4 = Solid.ByLoft(crossSections=transpose_6)
터파기_형상_겹침_해소_4 = Python(IN[0]=byLoft_4)  # CPython3; same code as 터파기_형상_겹침_해소
volume_12 = Solid.Volume(solid=터파기_형상_겹침_해소_4)
code_block_145 = CodeBlock(i=volume_12) { Math.Round(List.Flatten(i)/1000000000, 2); }
if_5 = If(test=code_block_141, true=code_block_142, false=code_block_145)
code_block_146 = CodeBlock { "M3"; }
count_27 = List.Count(list=code_block_145)
ofRepeatedItem_24 = List.OfRepeatedItem(item=code_block_146, amount=count_27)
code_block_147 = CodeBlock(FuncValues=if_5, FuncValuesUnit=ofRepeatedItem_24)  # same code as code_block_6
color_palette_6 = ColorPalette({R: 210, G: 105, B: 30, A: 135})
byGeometryColor_6 = Modifiers.GeometryColor.ByGeometryColor(geometry=터파기_형상_겹침_해소_4, color=color_palette_6)
forRefOutput_4 = CodeBlock(MainOutput=code_block_147, geoColor=byGeometryColor_6, 터파기형상=터파기_형상_겹침_해소_4)  # same code as forRefOutput

# group: Output Manager
output_23 = CodeBlock(MainOutput=forRefOutput_4, RefOutput_geoColor=byGeometryColor_6) { MainOutput; RefOutput_geoColor; }
reference_output_23 = CodeBlock(ref=터파기_형상_겹침_해소_4, ref2=if_5) { ref; ref2; }

# group: Visual Manager
visual_켜기_끄기_8 = BoolSelector(false)
visual_manager_8 = Python(IN[0]=output_23.RefOutput_geoColor, IN[1]=visual_켜기_끄기_8)  # CPython3; same code as visual_manager

# group: Visual Manager
visual_켜기_끄기_9 = BoolSelector(false)
visual_manager_9 = Python(IN[0]=output_22.RefOutput_geoColor, IN[1]=visual_켜기_끄기_9)  # CPython3; same code as visual_manager

# group: Input Manager
value_for_import_from_others_27 = CodeBlock(MainInput=code_block_132) { MainInput; RefInput1; RefInput2; }  # unwired: RefInput1, RefInput2

# group: <Func 0> Hardner Finish (상부면)
code_block_148 = CodeBlock { "TargetElements"; }
# note: <Func>
valueAtKey_31 = DesignScript.Builtin.Dictionary.ValueAtKey(dictionary=value_for_import_from_others_27.MainInput, key=code_block_148)
flatten_37 = List.Flatten(list=valueAtKey_31)
# note: 일반화 여지가 있음
# (형상처리구간 + 물량계산 + 데이터 매칭)
extractUpperFacesOfElement_3 = Custom[ExtractUpperFacesOfElement](Element=flatten_37)
area_8 = Surface.Area(surface=extractUpperFacesOfElement_3.Surface)
sum_4 = Math.Sum(values=area_8)
code_block_149 = CodeBlock(i=sum_4) { Math.Round(List.Flatten(i)/1000000, 2); }
code_block_150 = CodeBlock { "M2"; }
count_28 = List.Count(list=code_block_149)
ofRepeatedItem_25 = List.OfRepeatedItem(item=code_block_150, amount=count_28)
code_block_151 = CodeBlock(FuncValues=code_block_149, FuncValuesUnit=ofRepeatedItem_25)  # same code as code_block_6
color_palette_7 = ColorPalette({R: 30, G: 144, B: 255, A: 129})
byGeometryColor_7 = Modifiers.GeometryColor.ByGeometryColor(geometry=extractUpperFacesOfElement_3.Surface, color=color_palette_7)

# group: Output Manager
output_24 = CodeBlock(MainOutput=code_block_151, RefOutput_geoColor=byGeometryColor_7) { MainOutput; RefOutput_geoColor; }
reference_output_24 = CodeBlock { ref; }  # unwired: ref

# group: Input Manager
value_for_import_from_others_28 = CodeBlock(MainInput=code_block_132) { MainInput; RefInput1; RefInput2; }  # unwired: RefInput1, RefInput2

# group: <Func 1> Structural Concrete
code_block_152 = CodeBlock { "TargetElements"; }
valueAtKey_32 = DesignScript.Builtin.Dictionary.ValueAtKey(dictionary=value_for_import_from_others_28.MainInput, key=code_block_152)
# note: <Func>
geometry_4 = Element.Geometry(element=valueAtKey_32)
volume_13 = Solid.Volume(solid=geometry_4)
code_block_153 = CodeBlock(i=volume_13) { Math.Round(List.Flatten(i)/1000000000,2); }
code_block_154 = CodeBlock { "M3"; }
count_29 = List.Count(list=code_block_153)
ofRepeatedItem_26 = List.OfRepeatedItem(item=code_block_154, amount=count_29)
code_block_155 = CodeBlock(FuncValues=code_block_153, FuncValuesUnit=ofRepeatedItem_26)  # same code as code_block_6

# group: Output Manager
output_25 = CodeBlock(MainOutput=code_block_155) { MainOutput; RefOutput_geoColor; }  # unwired: RefOutput_geoColor
reference_output_25 = CodeBlock(ref=geometry_4) { ref; }

# group: Input Manager
value_for_import_from_others_29 = CodeBlock(MainInput=code_block_132) { MainInput; RefInput1; RefInput2; }  # unwired: RefInput1, RefInput2

# group: <Func 2> Form Works (Ground Slab 거푸집 필요X)
code_block_156 = CodeBlock { "TargetElements"; }
valueAtKey_33 = DesignScript.Builtin.Dictionary.ValueAtKey(dictionary=value_for_import_from_others_29.MainInput, key=code_block_156)
code_block_157 = CodeBlock { "Volume"; }
# note: <Func>
getParameterValueByName_9 = Element.GetParameterValueByName(element=valueAtKey_33, parameterName=code_block_157)
code_block_158 = CodeBlock(i=getParameterValueByName_9) { Math.Round(List.Flatten(i)/10000000,2); }
code_block_159 = CodeBlock { "M3"; }
count_30 = List.Count(list=code_block_158)
ofRepeatedItem_27 = List.OfRepeatedItem(item=code_block_159, amount=count_30)
code_block_160 = CodeBlock(FuncValues=code_block_158, FuncValuesUnit=ofRepeatedItem_27)  # same code as code_block_6

# group: Output Manager
output_26 = CodeBlock(MainOutput=code_block_160) { MainOutput; RefOutput_geoColor; }  # unwired: RefOutput_geoColor
reference_output_26 = CodeBlock { ref; }  # unwired: ref

# group: Input Manager
value_for_import_from_others_30 = CodeBlock(MainInput=code_block_132) { MainInput; RefInput1; RefInput2; }  # unwired: RefInput1, RefInput2

# group: <Func 3> PE Sheet
code_block_161 = CodeBlock { "TargetElements"; }
valueAtKey_34 = DesignScript.Builtin.Dictionary.ValueAtKey(dictionary=value_for_import_from_others_30.MainInput, key=code_block_161)
# note: <Func>
createLeanConcrete_6 = Custom[CreateLeanConcrete](Element=valueAtKey_34)
area_9 = Surface.Area(surface=createLeanConcrete_6.Surface)
code_block_162 = CodeBlock(i=area_9) { Math.Round(List.Flatten(i)/1000000, 2); }
code_block_163 = CodeBlock { "M2"; }
count_31 = List.Count(list=code_block_162)
ofRepeatedItem_28 = List.OfRepeatedItem(item=code_block_163, amount=count_31)
code_block_164 = CodeBlock(FuncValues=code_block_162, FuncValuesUnit=ofRepeatedItem_28)  # same code as code_block_6

# group: Output Manager
output_27 = CodeBlock(MainOutput=code_block_164) { MainOutput; RefOutput_geoColor; }  # unwired: RefOutput_geoColor
reference_output_27 = CodeBlock { ref; }  # unwired: ref

# group: Input Manager
value_for_import_from_others_31 = CodeBlock(MainInput=code_block_132, RefInput1=reference_output_22, RefInput2=reference_output_23.ref, RefInput3=reference_output_25) { MainInput; RefInput1; RefInput2; RefInput3; }

# group: <Func 5> Backfill
value_for_import_from_others_32 = CodeBlock(터파기형상=value_for_import_from_others_31.RefInput2) { 터파기형상; }
flatten_38 = List.Flatten(list=value_for_import_from_others_32)
volume_14 = Solid.Volume(solid=flatten_38)
watch_11 = Watch(volume_14)
code_block_165 = CodeBlock(i=watch_11) { Math.Round(List.Flatten(i)/1000000000, 2); }
code_block_166 = CodeBlock { "M3"; }
count_32 = List.Count(list=watch_11)
ofRepeatedItem_29 = List.OfRepeatedItem(item=code_block_166, amount=count_32)
# note: 터파기 물량ㅈ에서 콘크리트, 린 기둥 물량 빼기
code_block_167 = CodeBlock(FuncValues=code_block_165, FuncValuesUnit=ofRepeatedItem_29)  # same code as code_block_6
value_for_import_from_others_33 = CodeBlock(슬라브형상=value_for_import_from_others_31.RefInput3) { 슬라브형상; }
flatten_39 = List.Flatten(list=value_for_import_from_others_33)
doesIntersect_4 = Geometry.DoesIntersect(geometry=flatten_38, other=flatten_39, lacing=CrossProduct)
filterByBoolMask_3 = List.FilterByBoolMask(list=flatten_39, mask=doesIntersect_4@L2)
flatten_40 = List.Flatten(list=filterByBoolMask_3.in)

# group: Output Manager
output_28 = CodeBlock(MainOutput=code_block_167) { MainOutput; RefOutput_geoColor; }  # unwired: RefOutput_geoColor
reference_output_28 = CodeBlock { ref; }  # unwired: ref

# group: Input Manager
value_for_import_from_others_34 = CodeBlock(MainInput=code_block_132, RefInput1=reference_output_23.ref2) { MainInput; RefInput1; RefInput2; }  # unwired: RefInput2

# group: <Func 6>Disposal
code_block_168 = CodeBlock(i=value_for_import_from_others_34.RefInput1) { i==0?true:false; }
code_block_169 = CodeBlock { 0; }
# note: <Func>
if_6 = If(test=code_block_168, true=code_block_169, false=value_for_import_from_others_34.RefInput1)
code_block_170 = CodeBlock(i=if_6) { Math.Round(List.Flatten(i)/1000000000, 2); }
code_block_171 = CodeBlock { "M3"; }
count_33 = List.Count(list=code_block_170)
ofRepeatedItem_30 = List.OfRepeatedItem(item=code_block_171, amount=count_33)
code_block_172 = CodeBlock(FuncValues=code_block_170, FuncValuesUnit=ofRepeatedItem_30)  # same code as code_block_6
code_block_173 = CodeBlock { "TargetElements"; }
valueAtKey_35 = DesignScript.Builtin.Dictionary.ValueAtKey(dictionary=value_for_import_from_others_34.MainInput, key=code_block_173)
count_34 = List.Count(list=valueAtKey_35@L1)

# group: Output Manager
output_29 = CodeBlock(MainOutput=code_block_172) { MainOutput; RefOutput_geoColor; }  # unwired: RefOutput_geoColor
reference_output_29 = CodeBlock { ref; }  # unwired: ref

# group: Input Manager
value_for_import_from_others_35 = CodeBlock(MainInput=code_block_132) { MainInput; RefInput1; RefInput2; }  # unwired: RefInput1, RefInput2

# group: <Func 7>Base Course
code_block_174 = CodeBlock { "TargetElements"; }
valueAtKey_36 = DesignScript.Builtin.Dictionary.ValueAtKey(dictionary=value_for_import_from_others_35.MainInput, key=code_block_174)
code_block_175 = CodeBlock { 300; 100; }
# note: <Func>
createBaseCourseSurfaces_4 = Custom[CreateBaseCourseSurfaces](Element=valueAtKey_36, BaseCourseOffsetBottom=code_block_175.out0, leanThick=code_block_175.out1)
area_10 = Surface.Area(surface=createBaseCourseSurfaces_4.Surface)
code_block_176 = CodeBlock(i=area_10) { Math.Round(List.Flatten(i)/1000000, 2); }
code_block_177 = CodeBlock { "M2"; }
count_35 = List.Count(list=code_block_176)
ofRepeatedItem_31 = List.OfRepeatedItem(item=code_block_177, amount=count_35)
code_block_178 = CodeBlock(FuncValues=code_block_176, FuncValuesUnit=ofRepeatedItem_31)  # same code as code_block_6

# group: Output Manager
output_30 = CodeBlock(MainOutput=code_block_178) { MainOutput; RefOutput_geoColor; }  # unwired: RefOutput_geoColor
reference_output_30 = CodeBlock(ref=createBaseCourseSurfaces_4.Surface) { ref; }

# group: Input Manager
value_for_import_from_others_36 = CodeBlock(MainInput=code_block_132, RefInput1=reference_output_30) { MainInput; RefInput1; RefInput2; }  # unwired: RefInput2

# group: <Func 8>Crushed Stone
code_block_179 = CodeBlock { "TargetElements"; }
valueAtKey_37 = DesignScript.Builtin.Dictionary.ValueAtKey(dictionary=value_for_import_from_others_36.MainInput, key=code_block_179)
# note: <Func>
code_block_180 = CodeBlock { 300; 100; }
createBaseCourseSurfaces_5 = Custom[CreateBaseCourseSurfaces](Element=valueAtKey_37, BaseCourseOffsetBottom=code_block_180.out0, leanThick=code_block_180.out1)
boolean_2 = BoolSelector(false)
thicken_2 = Surface.Thicken(surface=createBaseCourseSurfaces_5.Surface, thickness=code_block_180.out0, both_sides=boolean_2)
volume_15 = Solid.Volume(solid=thicken_2)
code_block_181 = CodeBlock(i=volume_15) { Math.Round(List.Flatten(i)/1000000000, 2); }
code_block_182 = CodeBlock { "M3"; }
count_36 = List.Count(list=code_block_181)
ofRepeatedItem_32 = List.OfRepeatedItem(item=code_block_182, amount=count_36)
code_block_183 = CodeBlock(FuncValues=code_block_181, FuncValuesUnit=ofRepeatedItem_32)  # same code as code_block_6

# group: Output Manager
output_31 = CodeBlock(MainOutput=code_block_183) { MainOutput; RefOutput_geoColor; }  # unwired: RefOutput_geoColor
reference_output_31 = CodeBlock { ref; }  # unwired: ref

# group: Input Manager
value_for_import_from_others_37 = CodeBlock(MainInput=code_block_132) { MainInput; RefInput1; RefInput2; }  # unwired: RefInput1, RefInput2

# group: <Func 10>Rebar Work
code_block_184 = CodeBlock { "TargetElements"; }
valueAtKey_38 = DesignScript.Builtin.Dictionary.ValueAtKey(dictionary=value_for_import_from_others_37.MainInput, key=code_block_184)
code_block_185 = CodeBlock { "Volume"; }
# note: <Func>
getParameterValueByName_10 = Element.GetParameterValueByName(element=valueAtKey_38, parameterName=code_block_185)
sog_철근비_2 = DoubleInput(0)  # graph input
mul_3 = getParameterValueByName_10 * sog_철근비_2
code_block_186 = CodeBlock(i=mul_3) { Math.Round(List.Flatten(i)/1, 2); }
code_block_187 = CodeBlock { "TON"; }
count_37 = List.Count(list=code_block_186)
ofRepeatedItem_33 = List.OfRepeatedItem(item=code_block_187, amount=count_37)
code_block_188 = CodeBlock(FuncValues=code_block_186, FuncValuesUnit=ofRepeatedItem_33)  # same code as code_block_6

# group: Output Manager
output_32 = CodeBlock(MainOutput=code_block_188) { MainOutput; RefOutput_geoColor; }  # unwired: RefOutput_geoColor
reference_output_32 = CodeBlock { ref; }  # unwired: ref

join_3 = List.Join(list0=output_24.MainOutput, list1=output_25.MainOutput, list2=output_26.MainOutput, list3=output_27.MainOutput, list4=output_23.MainOutput, list5=output_28.MainOutput, list6=output_29.MainOutput, list7=output_30.MainOutput, list8=output_31.MainOutput, list9=output_22.MainOutput, list10=output_32.MainOutput)

# group: TargetWMunique + Data Sending
code_block_189 = CodeBlock(InputDic2=join_3) { _InputDic2; }
count_38 = List.Count(list=code_block_189)
code_block_190 = CodeBlock(InputDic1=code_block_131) { _InputDic1; }
code_block_191 = CodeBlock { "TargetWMunique"; }
valueAtKey_39 = DesignScript.Builtin.Dictionary.ValueAtKey(dictionary=code_block_190, key=code_block_191)
watch_12 = Watch(valueAtKey_39)
count_39 = List.Count(list=watch_12)
eq_2 = count_38 == count_39
organizeFuncValuesAndWorkMasterAsDiction_2 = Custom[OrganizeFuncValuesAndWorkMasterAsDictionary](InputDic1=code_block_190, InputDic2=code_block_189)
watch_13 = Watch()  # unwired: arg0
if_7 = If(test=eq_2, true=organizeFuncValuesAndWorkMasterAsDiction_2, false=watch_13)

watch_14 = Watch(output_23.MainOutput)

# group: <Func 6> Visual Manager
visual_켜기_끄기_10 = BoolSelector(false)
visual_manager_10 = Python(IN[0]=output_24.RefOutput_geoColor, IN[1]=visual_켜기_끄기_10)  # CPython3; same code as visual_manager

# group: Input Manager
value_for_import_from_others_38 = CodeBlock(MainInput=code_block) { MainInput; RefInput1; RefInput2; }  # unwired: RefInput1, RefInput2

# group: <Func 00>Crushed Stone
code_block_192 = CodeBlock { "TargetElements"; }
valueAtKey_40 = DesignScript.Builtin.Dictionary.ValueAtKey(dictionary=value_for_import_from_others_38.MainInput, key=code_block_192)
# note: <Func>
code_block_193 = CodeBlock { 300; 100; }
createBaseCourseSurfaces_6 = Custom[CreateBaseCourseSurfaces](Element=valueAtKey_40, BaseCourseOffsetBottom=code_block_193.out0, leanThick=code_block_193.out1)
boolean_3 = BoolSelector(false)
thicken_3 = Surface.Thicken(surface=createBaseCourseSurfaces_6.Surface, thickness=code_block_193.out0, both_sides=boolean_3)
volume_16 = Solid.Volume(solid=thicken_3)
code_block_194 = CodeBlock(i=volume_16) { Math.Round(List.Flatten(i)/1000000000, 2); }
code_block_195 = CodeBlock { "M3"; }
count_40 = List.Count(list=code_block_194)
ofRepeatedItem_34 = List.OfRepeatedItem(item=code_block_195, amount=count_40)
code_block_196 = CodeBlock(FuncValues=code_block_194, FuncValuesUnit=ofRepeatedItem_34)  # same code as code_block_6

# group: Output Manager
output_33 = CodeBlock(MainOutput=code_block_196) { MainOutput; RefOutput_geoColor; }  # unwired: RefOutput_geoColor
reference_output_33 = CodeBlock { ref; }  # unwired: ref

# group: Visual Manager
visual_켜기_끄기_11 = BoolSelector(false)
visual_manager_11 = Python(IN[0]=output_11.RefOutput_geoColor, IN[1]=visual_켜기_끄기_11)  # CPython3; same code as visual_manager

code_block_197 = CodeBlock { i; }  # unwired: i

# group: Input Manager
value_for_import_from_others_39 = CodeBlock(MainInput=code_block_197) { MainInput; RefInput1; RefInput2; }  # unwired: RefInput1, RefInput2

# group: <Func 0> Hardner Finish (상부면)
code_block_198 = CodeBlock { "TargetElements"; }
# note: <Func>
valueAtKey_41 = DesignScript.Builtin.Dictionary.ValueAtKey(dictionary=value_for_import_from_others_39.MainInput, key=code_block_198)
flatten_41 = List.Flatten(list=valueAtKey_41)
# note: 일반화 여지가 있음
# (형상처리구간 + 물량계산 + 데이터 매칭)
extractUpperFacesOfElement_4 = Custom[ExtractUpperFacesOfElement](Element=flatten_41)
area_11 = Surface.Area(surface=extractUpperFacesOfElement_4.Surface)
sum_5 = Math.Sum(values=area_11)
code_block_199 = CodeBlock(i=sum_5) { Math.Round(List.Flatten(i)/1000000, 2); }
code_block_200 = CodeBlock { "M2"; }
count_41 = List.Count(list=code_block_199)
ofRepeatedItem_35 = List.OfRepeatedItem(item=code_block_200, amount=count_41)
code_block_201 = CodeBlock(FuncValues=code_block_199, FuncValuesUnit=ofRepeatedItem_35)  # same code as code_block_6
color_palette_8 = ColorPalette({R: 30, G: 144, B: 255, A: 129})
byGeometryColor_8 = Modifiers.GeometryColor.ByGeometryColor(geometry=extractUpperFacesOfElement_4.Surface, color=color_palette_8)

# group: Output Manager
reference_output_34 = CodeBlock { ref; }  # unwired: ref
output_34 = CodeBlock(MainOutput=code_block_201, RefOutput_geoColor=byGeometryColor_8) { MainOutput; RefOutput_geoColor; }

# group: <Func 6> Visual Manager
visual_켜기_끄기_12 = BoolSelector(false)
visual_manager_12 = Python(IN[0]=output_34.RefOutput_geoColor, IN[1]=visual_켜기_끄기_12)  # CPython3; same code as visual_manager

# group: Input Manager
value_for_import_from_others_40 = CodeBlock(MainInput=code_block_197) { MainInput; RefInput1; RefInput2; }  # unwired: RefInput1, RefInput2

# group: <Func 9>Lean Concrete
code_block_202 = CodeBlock { "TargetElements"; }
valueAtKey_42 = DesignScript.Builtin.Dictionary.ValueAtKey(dictionary=value_for_import_from_others_40.MainInput, key=code_block_202)
code_block_203 = CodeBlock { 0; 100; }
# note: <Func>
createLeanConcrete_7 = Custom[CreateLeanConcrete](Element=valueAtKey_42, leanOffset=code_block_203.out0, leanThick=code_block_203.out1)
volume_17 = Solid.Volume(solid=createLeanConcrete_7.Solid)
code_block_204 = CodeBlock(i=volume_17) { Math.Round(List.Flatten(i)/1000000000, 2); }
code_block_205 = CodeBlock { "M3"; }
count_42 = List.Count(list=code_block_204)
ofRepeatedItem_36 = List.OfRepeatedItem(item=code_block_205, amount=count_42)
code_block_206 = CodeBlock(FuncValues=code_block_204, FuncValuesUnit=ofRepeatedItem_36)  # same code as code_block_6

# group: Output Manager
reference_output_35 = CodeBlock(ref=createLeanConcrete_7.Solid) { ref; }
output_35 = CodeBlock(MainOutput=code_block_206, RefOutput_geoColor=createLeanConcrete_7.Solid) { MainOutput; RefOutput_geoColor; }

# group: Input Manager
value_for_import_from_others_41 = CodeBlock(MainInput=code_block_197, RefInput1=reference_output_35) { MainInput; RefInput1; RefInput2; }  # unwired: RefInput2

# group: <Func 4> Excavation (SOG 한정)
levels_5 = Levels("G.L")  # graph input
elevation_5 = Level.Elevation(level=levels_5)
code_block_207 = CodeBlock { "TargetElements"; }
valueAtKey_43 = DesignScript.Builtin.Dictionary.ValueAtKey(dictionary=value_for_import_from_others_41.MainInput, key=code_block_207)
code_block_208 = CodeBlock { "Elevation at Bottom"; }
getParameterValueByName_11 = Element.GetParameterValueByName(element=valueAtKey_43, parameterName=code_block_208)
린_콘크리트_하부까지의_길이_추출_최하단_5 = Python(IN[0]=value_for_import_from_others_41.RefInput1)  # CPython3; same code as 린_콘크리트_하부까지의_길이_추출_최하단
code_block_209 = CodeBlock(기초하단=getParameterValueByName_11, 린콘크리트하단=린_콘크리트_하부까지의_길이_추출_최하단_5) { 기초하단-린콘크리트하단; }
sub_5 = elevation_5 - code_block_209
code_block_210 = CodeBlock(i=sub_5) { i<0?true:false; }
code_block_211 = CodeBlock { 0; }
flatten_42 = List.Flatten(list=value_for_import_from_others_41.RefInput1)
하부_surface_추출_6 = Python(IN[0]=flatten_42)  # CPython3; same code as 하부_surface_추출
flatten_43 = List.Flatten(list=하부_surface_추출_6)
perimeterCurves_5 = Surface.PerimeterCurves(surface=flatten_43)
byJoinedCurves_5 = PolyCurve.ByJoinedCurves(curves=perimeterCurves_5)
code_block_212 = CodeBlock { _ExcavOffsetBottom: var[]..[] = 300; }
offset_9 = Curve.Offset(curve=byJoinedCurves_5, distance=code_block_212)
flatten_44 = List.Flatten(list=offset_9)
flatten_45 = List.Flatten(list=sub_5)
translate_5 = Geometry.Translate(geometry=offset_9, zTranslation=flatten_45)
경사_비율_입력_1_x_for_isofdn_4 = DoubleInput(2)  # graph input
code_block_213 = CodeBlock(ElevationatBottom=flatten_45, 비율=경사_비율_입력_1_x_for_isofdn_4) { ElevationatBottom/비율; }
offset_10 = Curve.Offset(curve=translate_5, distance=code_block_213)
flatten_46 = List.Flatten(list=offset_10)
list_create_7 = List.Create(item0=flatten_44, item1=flatten_46)
transpose_7 = List.Transpose(lists=list_create_7)
byLoft_5 = Solid.ByLoft(crossSections=transpose_7)
터파기_형상_겹침_해소_5 = Python(IN[0]=byLoft_5)  # CPython3; same code as 터파기_형상_겹침_해소
volume_18 = Solid.Volume(solid=터파기_형상_겹침_해소_5)
code_block_214 = CodeBlock(i=volume_18) { Math.Round(List.Flatten(i)/1000000000, 2); }
if_8 = If(test=code_block_210, true=code_block_211, false=code_block_214)
code_block_215 = CodeBlock { "M3"; }
count_43 = List.Count(list=code_block_214)
ofRepeatedItem_37 = List.OfRepeatedItem(item=code_block_215, amount=count_43)
code_block_216 = CodeBlock(FuncValues=if_8, FuncValuesUnit=ofRepeatedItem_37)  # same code as code_block_6
color_palette_9 = ColorPalette({R: 210, G: 105, B: 30, A: 135})
byGeometryColor_9 = Modifiers.GeometryColor.ByGeometryColor(geometry=터파기_형상_겹침_해소_5, color=color_palette_9)
forRefOutput_5 = CodeBlock(MainOutput=code_block_216, geoColor=byGeometryColor_9, 터파기형상=터파기_형상_겹침_해소_5)  # same code as forRefOutput

# group: Output Manager
output_36 = CodeBlock(MainOutput=forRefOutput_5, RefOutput_geoColor=byGeometryColor_9) { MainOutput; RefOutput_geoColor; }
reference_output_36 = CodeBlock(ref=터파기_형상_겹침_해소_5, ref2=if_8) { ref; ref2; }

# group: Visual Manager
visual_켜기_끄기_13 = BoolSelector(false)
visual_manager_13 = Python(IN[0]=output_36.RefOutput_geoColor, IN[1]=visual_켜기_끄기_13)  # CPython3; same code as visual_manager

# group: Input Manager
value_for_import_from_others_42 = CodeBlock(MainInput=code_block_197) { MainInput; RefInput1; RefInput2; }  # unwired: RefInput1, RefInput2

# group: <Func 1> Structural Concrete
code_block_217 = CodeBlock { "TargetElements"; }
valueAtKey_44 = DesignScript.Builtin.Dictionary.ValueAtKey(dictionary=value_for_import_from_others_42.MainInput, key=code_block_217)
# note: <Func>
geometry_5 = Element.Geometry(element=valueAtKey_44)
volume_19 = Solid.Volume(solid=geometry_5)
code_block_218 = CodeBlock(i=volume_19) { Math.Round(List.Flatten(i)/1000000000,2); }
code_block_219 = CodeBlock { "M3"; }
count_44 = List.Count(list=code_block_218)
ofRepeatedItem_38 = List.OfRepeatedItem(item=code_block_219, amount=count_44)
code_block_220 = CodeBlock(FuncValues=code_block_218, FuncValuesUnit=ofRepeatedItem_38)  # same code as code_block_6

# group: Output Manager
reference_output_37 = CodeBlock(ref=geometry_5) { ref; }
output_37 = CodeBlock(MainOutput=code_block_220) { MainOutput; RefOutput_geoColor; }  # unwired: RefOutput_geoColor

# group: Input Manager
value_for_import_from_others_43 = CodeBlock(MainInput=code_block_197, RefInput1=reference_output_35, RefInput2=reference_output_36.ref, RefInput3=reference_output_37) { MainInput; RefInput1; RefInput2; RefInput3; }

# group: <Func 2> Backfill
value_for_import_from_others_44 = CodeBlock(슬라브형상=value_for_import_from_others_43.RefInput3) { 슬라브형상; }
flatten_47 = List.Flatten(list=value_for_import_from_others_44)
value_for_import_from_others_45 = CodeBlock(터파기형상=value_for_import_from_others_43.RefInput2) { 터파기형상; }
flatten_48 = List.Flatten(list=value_for_import_from_others_45)
doesIntersect_5 = Geometry.DoesIntersect(geometry=flatten_48, other=flatten_47, lacing=CrossProduct)
filterByBoolMask_4 = List.FilterByBoolMask(list=flatten_47, mask=doesIntersect_5@L2)
flatten_49 = List.Flatten(list=filterByBoolMask_4.in)
volume_20 = Solid.Volume(solid=flatten_48)
watch_15 = Watch(volume_20)
code_block_221 = CodeBlock(i=watch_15) { Math.Round(List.Flatten(i)/1000000000, 2); }
code_block_222 = CodeBlock { "M3"; }
count_45 = List.Count(list=watch_15)
ofRepeatedItem_39 = List.OfRepeatedItem(item=code_block_222, amount=count_45)
# note: 터파기 물량ㅈ에서 콘크리트, 린 기둥 물량 빼기
code_block_223 = CodeBlock(FuncValues=code_block_221, FuncValuesUnit=ofRepeatedItem_39)  # same code as code_block_6

# group: Output Manager
reference_output_38 = CodeBlock { ref; }  # unwired: ref
output_38 = CodeBlock(MainOutput=code_block_223) { MainOutput; RefOutput_geoColor; }  # unwired: RefOutput_geoColor

watch_16 = Watch(output_36.MainOutput)

# group: Input Manager
value_for_import_from_others_46 = CodeBlock(MainInput=code_block_197) { MainInput; RefInput1; RefInput2; }  # unwired: RefInput1, RefInput2

# group: <Func 2> Form Works (Ground Slab 거푸집 필요X)
code_block_224 = CodeBlock { "TargetElements"; }
valueAtKey_45 = DesignScript.Builtin.Dictionary.ValueAtKey(dictionary=value_for_import_from_others_46.MainInput, key=code_block_224)
code_block_225 = CodeBlock { "Volume"; }
# note: <Func>
getParameterValueByName_12 = Element.GetParameterValueByName(element=valueAtKey_45, parameterName=code_block_225)
code_block_226 = CodeBlock(i=getParameterValueByName_12) { Math.Round(List.Flatten(i)/10000000,2); }
code_block_227 = CodeBlock { "M3"; }
count_46 = List.Count(list=code_block_226)
ofRepeatedItem_40 = List.OfRepeatedItem(item=code_block_227, amount=count_46)
code_block_228 = CodeBlock(FuncValues=code_block_226, FuncValuesUnit=ofRepeatedItem_40)  # same code as code_block_6

# group: Output Manager
reference_output_39 = CodeBlock { ref; }  # unwired: ref
output_39 = CodeBlock(MainOutput=code_block_228) { MainOutput; RefOutput_geoColor; }  # unwired: RefOutput_geoColor

# group: Input Manager
value_for_import_from_others_47 = CodeBlock(MainInput=code_block_197) { MainInput; RefInput1; RefInput2; }  # unwired: RefInput1, RefInput2

# group: <Func 3> PE Sheet
code_block_229 = CodeBlock { "TargetElements"; }
valueAtKey_46 = DesignScript.Builtin.Dictionary.ValueAtKey(dictionary=value_for_import_from_others_47.MainInput, key=code_block_229)
# note: <Func>
createLeanConcrete_8 = Custom[CreateLeanConcrete](Element=valueAtKey_46)
area_12 = Surface.Area(surface=createLeanConcrete_8.Surface)
code_block_230 = CodeBlock(i=area_12) { Math.Round(List.Flatten(i)/1000000, 2); }
code_block_231 = CodeBlock { "M2"; }
count_47 = List.Count(list=code_block_230)
ofRepeatedItem_41 = List.OfRepeatedItem(item=code_block_231, amount=count_47)
code_block_232 = CodeBlock(FuncValues=code_block_230, FuncValuesUnit=ofRepeatedItem_41)  # same code as code_block_6

# group: Output Manager
reference_output_40 = CodeBlock { ref; }  # unwired: ref
output_40 = CodeBlock(MainOutput=code_block_232) { MainOutput; RefOutput_geoColor; }  # unwired: RefOutput_geoColor

# group: Input Manager
value_for_import_from_others_48 = CodeBlock(MainInput=code_block_197, RefInput1=reference_output_36.ref2) { MainInput; RefInput1; RefInput2; }  # unwired: RefInput2

# group: <Func 6>Disposal
code_block_233 = CodeBlock(i=value_for_import_from_others_48.RefInput1) { i==0?true:false; }
code_block_234 = CodeBlock { 0; }
# note: <Func>
if_9 = If(test=code_block_233, true=code_block_234, false=value_for_import_from_others_48.RefInput1)
code_block_235 = CodeBlock(i=if_9) { Math.Round(List.Flatten(i)/1000000000, 2); }
code_block_236 = CodeBlock { "M3"; }
count_48 = List.Count(list=code_block_235)
ofRepeatedItem_42 = List.OfRepeatedItem(item=code_block_236, amount=count_48)
code_block_237 = CodeBlock(FuncValues=code_block_235, FuncValuesUnit=ofRepeatedItem_42)  # same code as code_block_6
code_block_238 = CodeBlock { "TargetElements"; }
valueAtKey_47 = DesignScript.Builtin.Dictionary.ValueAtKey(dictionary=value_for_import_from_others_48.MainInput, key=code_block_238)
count_49 = List.Count(list=valueAtKey_47@L1)

# group: Output Manager
output_41 = CodeBlock(MainOutput=code_block_237) { MainOutput; RefOutput_geoColor; }  # unwired: RefOutput_geoColor
reference_output_41 = CodeBlock { ref; }  # unwired: ref

# group: Input Manager
value_for_import_from_others_49 = CodeBlock(MainInput=code_block_197) { MainInput; RefInput1; RefInput2; }  # unwired: RefInput1, RefInput2

# group: <Func 7>Base Course
code_block_239 = CodeBlock { "TargetElements"; }
valueAtKey_48 = DesignScript.Builtin.Dictionary.ValueAtKey(dictionary=value_for_import_from_others_49.MainInput, key=code_block_239)
code_block_240 = CodeBlock { 300; 100; }
# note: <Func>
createBaseCourseSurfaces_7 = Custom[CreateBaseCourseSurfaces](Element=valueAtKey_48, BaseCourseOffsetBottom=code_block_240.out0, leanThick=code_block_240.out1)
area_13 = Surface.Area(surface=createBaseCourseSurfaces_7.Surface)
code_block_241 = CodeBlock(i=area_13) { Math.Round(List.Flatten(i)/1000000, 2); }
code_block_242 = CodeBlock { "M2"; }
count_50 = List.Count(list=code_block_241)
ofRepeatedItem_43 = List.OfRepeatedItem(item=code_block_242, amount=count_50)
code_block_243 = CodeBlock(FuncValues=code_block_241, FuncValuesUnit=ofRepeatedItem_43)  # same code as code_block_6

# group: Output Manager
output_42 = CodeBlock(MainOutput=code_block_243) { MainOutput; RefOutput_geoColor; }  # unwired: RefOutput_geoColor
reference_output_42 = CodeBlock(ref=createBaseCourseSurfaces_7.Surface) { ref; }

# group: Input Manager
value_for_import_from_others_50 = CodeBlock(MainInput=code_block_197, RefInput1=reference_output_42) { MainInput; RefInput1; RefInput2; }  # unwired: RefInput2

# group: <Func 8>Crushed Stone
code_block_244 = CodeBlock { "TargetElements"; }
valueAtKey_49 = DesignScript.Builtin.Dictionary.ValueAtKey(dictionary=value_for_import_from_others_50.MainInput, key=code_block_244)
# note: <Func>
code_block_245 = CodeBlock { 300; 100; }
createBaseCourseSurfaces_8 = Custom[CreateBaseCourseSurfaces](Element=valueAtKey_49, BaseCourseOffsetBottom=code_block_245.out0, leanThick=code_block_245.out1)
boolean_4 = BoolSelector(false)
thicken_4 = Surface.Thicken(surface=createBaseCourseSurfaces_8.Surface, thickness=code_block_245.out0, both_sides=boolean_4)
volume_21 = Solid.Volume(solid=thicken_4)
code_block_246 = CodeBlock(i=volume_21) { Math.Round(List.Flatten(i)/1000000000, 2); }
code_block_247 = CodeBlock { "M3"; }
count_51 = List.Count(list=code_block_246)
ofRepeatedItem_44 = List.OfRepeatedItem(item=code_block_247, amount=count_51)
code_block_248 = CodeBlock(FuncValues=code_block_246, FuncValuesUnit=ofRepeatedItem_44)  # same code as code_block_6

# group: Output Manager
output_43 = CodeBlock(MainOutput=code_block_248) { MainOutput; RefOutput_geoColor; }  # unwired: RefOutput_geoColor
reference_output_43 = CodeBlock { ref; }  # unwired: ref

# group: Input Manager
value_for_import_from_others_51 = CodeBlock(MainInput=code_block_197) { MainInput; RefInput1; RefInput2; }  # unwired: RefInput1, RefInput2

# group: <Func 10>Rebar Work
code_block_249 = CodeBlock { "TargetElements"; }
valueAtKey_50 = DesignScript.Builtin.Dictionary.ValueAtKey(dictionary=value_for_import_from_others_51.MainInput, key=code_block_249)
code_block_250 = CodeBlock { "Volume"; }
# note: <Func>
getParameterValueByName_13 = Element.GetParameterValueByName(element=valueAtKey_50, parameterName=code_block_250)
sog_철근비_3 = DoubleInput(0)  # graph input
mul_4 = getParameterValueByName_13 * sog_철근비_3
code_block_251 = CodeBlock(i=mul_4) { Math.Round(List.Flatten(i)/1, 2); }
code_block_252 = CodeBlock { "TON"; }
count_52 = List.Count(list=code_block_251)
ofRepeatedItem_45 = List.OfRepeatedItem(item=code_block_252, amount=count_52)
code_block_253 = CodeBlock(FuncValues=code_block_251, FuncValuesUnit=ofRepeatedItem_45)  # same code as code_block_6

# group: Output Manager
output_44 = CodeBlock(MainOutput=code_block_253) { MainOutput; RefOutput_geoColor; }  # unwired: RefOutput_geoColor
reference_output_44 = CodeBlock { ref; }  # unwired: ref

join_4 = List.Join(list0=output_34.MainOutput, list1=output_37.MainOutput, list2=output_39.MainOutput, list3=output_40.MainOutput, list4=output_36.MainOutput, list5=output_38.MainOutput, list6=output_41.MainOutput, list7=output_42.MainOutput, list8=output_43.MainOutput, list9=output_35.MainOutput, list10=output_44.MainOutput)

# group: Primary Input : Excel & Revit Elements
all_elements_of_category_2 = ElementsOfCategory()  # unwired: Category
string_from_web = Python()  # CPython3; unwired: IN[0]
# ---------- string_from_web.python (19 lines) ----------
# Load the Python Standard and DesignScript Libraries
import sys
import clr
clr.AddReference('ProtoGeometry')
from Autodesk.DesignScript.Geometry import *
import urllib.request

# The inputs to this node will be stored as a list in the IN variables.
dataEnteringNode = IN
inputURL = "https://raw.githubusercontent.com/HNANmal/mQ/master/Hdynlib/General/ImportExcel.py"

# Place your code below this line
req = urllib.request
data = req.urlopen(inputURL)

result = data.read().decode("utf-8")

# Assign your output to the OUT variable.
OUT = result
# ----------------------------------------
sheet_name = CodeBlock { "Str Foundations"; }
github_python_import_excel_by = PythonStringNode(script=string_from_web, IN[1]=sheet_name)  # "Github_Python@Import Excel(By OpenpyXl)"; CPython3; unwired: IN[0]
code_block_254 = CodeBlock(InputElement=all_elements_of_category_2, InputData=github_python_import_excel_by) { _InputElement; _InputData; }
categories_2 = Categories("OST_StructuralFoundation")
file_path = Filename(".\DMS(Data Matching Schedule)_R0(Seq.1)(2).xlsx")  # graph input

# group: GetFull WMCodeDescription PerElement
excelDataManagerNode = Python(IN[0]=code_block_254._InputElement, IN[1]=code_block_254._InputData)  # CPython3
# ---------- excelDataManagerNode.python (279 lines) ----------
# Load the Python Standard and DesignScript Libraries
import os
import sys
sys.path.append(os.getenv('LOCALAPPDATA').replace('\\','\\\\') + r'\Programs\Python\Python39\Lib\site-packages')
import clr
clr.AddReference('RevitAPI')
import Autodesk

clr.AddReference('ProtoGeometry')
from Autodesk.DesignScript.Geometry import *

clr.AddReference('RevitNodes')
import Revit
clr.ImportExtensions(Revit.Elements)

clr.ImportExtensions(Revit.GeometryConversion)
clr.ImportExtensions(Revit.GeometryReferences)

clr.AddReference('RevitServices')
import RevitServices
from RevitServices.Persistence import DocumentManager
from RevitServices.Transactions import TransactionManager

doc = DocumentManager.Instance.CurrentDBDocument

import random
import itertools
from functools import reduce
from collections import Iterable
import datetime
import openpyxl

def iterable(obj):
    return isinstance(obj, Iterable)

def findUnique(inputs):
    result = []
    for i in inputs:
        if i in result:
            pass
        else:
            result.append(i)
    return result

# The inputs to this node will be stored as a list in the IN variables.
dataEnteringNode = IN
inputElements = IN[0]
inputData = IN[1]
#inputSheetName = IN[2]

def importExcel(path, SheetNameIn):
    wb_obj = openpyxl.load_workbook(str(path), data_only=True)
    sheet_obj = wb_obj.get_sheet_by_name(str(SheetNameIn))

    m_row = sheet_obj.max_row
    m_col = sheet_obj.max_column

    listOut = []

    for i in range(1, m_row +1):
        listTemp = []
        for j in range(1, m_col + 1):
            cell_obj = sheet_obj.cell(row=i, column=j)
            listTemp.append(cell_obj.value)
            if len(listTemp) == m_col:
                listOut.append(listTemp)
    return listOut

def getUsedFamilyTypeOfModeling(elements):
    familyCode = list(map(lambda x: x.Name.split('_')[0], elements))
    unq_familyCode = findUnique(familyCode)
    return unq_familyCode
    
def createExcelDataDictionary(values):
    result = {}
    for i in range(len(values)):
        result[str(i)] = values[i]
    return result

def findTargetIndex(targets, list):
    result = []
    for target in targets:
        for i in range(len(list)):
            if target in str(list[i]):
                result.append(i)
            else:
                pass
    result.sort()
    return result
    
def GetValueAtKeys(keys, dictionary):
    result = [] 
    for i in keys:
        result.append(dictionary[str(i)])
    return result


# Place your code below this line
usedFamilyTypeOfModeling = getUsedFamilyTypeOfModeling(inputElements)
excelWholeDataSet = inputData#importExcel(inputFilePath, inputSheetName)
trExcelWholeDataSet = list(zip(*excelWholeDataSet))
excelColumnDataSet = createExcelDataDictionary(trExcelWholeDataSet)
excelRowDataSet = createExcelDataDictionary(excelWholeDataSet)
ColumnIndexOfUsedFamilyType = findTargetIndex(usedFamilyTypeOfModeling, trExcelWholeDataSet)
ColDataSetOfUsedFamilyType = GetValueAtKeys(ColumnIndexOfUsedFamilyType, excelColumnDataSet)
materialPerElementFromModeling = []
for i in inputElements:
    materialPerElementFromModeling.append(i.GetMaterials())
#list(map(lambda x: x.GetMaterials, inputElements)) "맵함수로 처리하면 리스트화 할 때 타입 변환 오류 남"

targetWMRowIndex = []
for i in ColDataSetOfUsedFamilyType:
    targetWMRowIndex.append(findTargetIndex(['000'], i))

rowDataSetOfUsedWM = []
for i in targetWMRowIndex:
    rowDataSetOfUsedWM.append(GetValueAtKeys(i, excelRowDataSet))

workGroup = []
for i in rowDataSetOfUsedWM:
    tmp = []
    for j in i:
        tmp.append(j[0])
    workGroup.append(tmp)
    
workMaster = []
for i in range(len(ColDataSetOfUsedFamilyType)):
    tmp=[]
    for k in targetWMRowIndex[i]:
        tmp.append(ColDataSetOfUsedFamilyType[i][k])
    workMaster.append(tmp)

matchedWM = []
for i in range(len(workGroup)):
    tmp = []
    for j in range(len(workGroup[i])):
        fullWM = workGroup[i][j] +"-"+ workMaster[i][j]
        tmp.append(fullWM)
    matchedWM.append(tmp)

matchedWorkGruopAndMasterCode = []
for i in matchedWM:
    if len(i) > 0:
        matchedWorkGruopAndMasterCode.append(i)
    else:
        pass

matchedWMDescription = []
for i in rowDataSetOfUsedWM:
    tmp=[]
    for j in i:
        tmp.append(j[1] +" "+ j[2] +" "+ j[3] +" "+ "("+ j[4] +")")
    if len(tmp) > 0:
        matchedWMDescription.append(tmp)
    else:
        pass

matchedWMUnit = []
for i in rowDataSetOfUsedWM:
    tmp=[]
    for j in i:
        tmp.append(j[4])
    if len(tmp) > 0:
        matchedWMUnit.append(tmp)
    else:
        pass

matchedWorkGruopAndMasterCode_flat = list(itertools.chain(*matchedWorkGruopAndMasterCode))
matchedWMDescription_flat = list(itertools.chain(*matchedWMDescription))

dic_WMandDescription_Excel = {}
for i in range(len(matchedWorkGruopAndMasterCode_flat)):
    dic_WMandDescription_Excel[matchedWorkGruopAndMasterCode_flat[i]] = matchedWMDescription_flat[i]

usedFamilyTypeInExcelOrder = list(map(lambda x: x[3], ColDataSetOfUsedFamilyType))
usedFamilyCodeInExcelOrder = findUnique(list(map(lambda x: x.split('_')[0], usedFamilyTypeInExcelOrder)))

dic_FamilyCodeandWM = {}
for i in range(len(usedFamilyCodeInExcelOrder)):
    dic_FamilyCodeandWM[usedFamilyCodeInExcelOrder[i]] = matchedWorkGruopAndMasterCode[i]

workMasterCodePerElement = []
familyCodePerElem = list(map(lambda x: x.Name.split('_')[0], inputElements))
for i in familyCodePerElem:
    workMasterCodePerElement.append(dic_FamilyCodeandWM[i])

materialNamePerElem = []
for i in materialPerElementFromModeling:
    tmp = []
    for j in i:
        tmp.append(j.Name)
    materialNamePerElem.append(tmp)

WMPerElementFromModeling = []
for i in materialNamePerElem:
    tmp = []
    for j in i:
        tmp.append(j.split('_')[0])
    WMPerElementFromModeling.append(tmp)

specPerElementFromModeling = []
for i in materialNamePerElem:
    tmp = []
    for j in i:
        a = j.split('_')
        del a[0]
        b = " ".join(a)
        tmp.append(b)
    specPerElementFromModeling.append(tmp)

WMPerElementFromModeling_flat = list(itertools.chain(*WMPerElementFromModeling))
specPerElementFromModeling_flat = list(itertools.chain(*specPerElementFromModeling))

dic_WMandDescription_Model = {}
for i in range(len(WMPerElementFromModeling_flat)):
    dic_WMandDescription_Model[WMPerElementFromModeling_flat[i]] = specPerElementFromModeling_flat[i]

def findAllKeys(dict):
    result = []
    for key in dict.keys():
        result.append(key)
    return result

def findAllValues(dict):
    result = []
    for key in dict.keys():
        result.append(dict[key])
    return result

keys_WMandDescription_Model = findAllKeys(dic_WMandDescription_Model)
keys_WMandDescription_Excel = findAllKeys(dic_WMandDescription_Excel)

keys_WMandDescription_Both = list(set(keys_WMandDescription_Model + keys_WMandDescription_Excel))
values_WMandDescription_Both = []
for i in keys_WMandDescription_Both:
    if i in keys_WMandDescription_Model:
        values_WMandDescription_Both.append(dic_WMandDescription_Model[i])
    else:
        values_WMandDescription_Both.append(dic_WMandDescription_Excel[i])

dic_WMandDescription_Both = {}
for i in range(len(keys_WMandDescription_Both)):
    dic_WMandDescription_Both[keys_WMandDescription_Both[i]] = values_WMandDescription_Both[i]

workMasterCodePerElementFromBoth = []
for i in range(len(workMasterCodePerElement)):
    #tmp = []
    a = WMPerElementFromModeling[i] + workMasterCodePerElement[i]
    b = findUnique(a)
    workMasterCodePerElementFromBoth.append(b)

specPerElement = []
for i in workMasterCodePerElementFromBoth:
    tmp = []
    for j in i:
        tmp.append(dic_WMandDescription_Both[j])
    specPerElement.append(tmp)

fullWMCodeDescriptionPerElement = []
for i in range(len(workMasterCodePerElementFromBoth)):
    tmp = []
    for j in range(len(workMasterCodePerElementFromBoth[i])):
        a = workMasterCodePerElementFromBoth[i][j] +": "+ specPerElement[i][j]
        tmp.append(a)
    fullWMCodeDescriptionPerElement.append(tmp)

fullWMinfo = {
"AllElement": inputElements,
"WorkMasterCodePerFamilyType": dic_FamilyCodeandWM,
"WorkMasterCodePerElementBoth": workMasterCodePerElementFromBoth,
"FullWMCodeDescriptionPerElement": fullWMCodeDescriptionPerElement
}



result = fullWMinfo

# Assign your output to the OUT variable.
OUT = result
# ----------------------------------------

# group: Organize AllElementInform AsDictionary
set_up_all_element_inform_as = Python(IN[0]=excelDataManagerNode)  # "Set Up All Element Inform as Dictionary"; CPython3
# ---------- set_up_all_element_inform_as.python (119 lines) ----------
# Load the Python Standard and DesignScript Libraries
import os
import sys
sys.path.append(os.getenv('LOCALAPPDATA').replace('\\','\\\\') + r'\Programs\Python\Python39\Lib\site-packages')
import clr
clr.AddReference('RevitAPI')
import Autodesk

clr.AddReference('ProtoGeometry')
from Autodesk.DesignScript.Geometry import *

clr.AddReference('RevitNodes')
import Revit
clr.ImportExtensions(Revit.Elements)

clr.ImportExtensions(Revit.GeometryConversion)
clr.ImportExtensions(Revit.GeometryReferences)

clr.AddReference('RevitServices')
import RevitServices
from RevitServices.Persistence import DocumentManager
from RevitServices.Transactions import TransactionManager

doc = DocumentManager.Instance.CurrentDBDocument

import random
import itertools
from functools import reduce
from collections import Iterable
import datetime
import openpyxl

def iterable(obj):
    return isinstance(obj, Iterable)

def findUnique(inputs):
    result = []
    for i in inputs:
        if i in result:
            pass
        else:
            result.append(i)
    return result

# The inputs to this node will be stored as a list in the IN variables.
dataEnteringNode = IN
inputDict = IN[0]


def importExcel(path, SheetNameIn):
    wb_obj = openpyxl.load_workbook(str(path), data_only=True)
    sheet_obj = wb_obj.get_sheet_by_name(str(SheetNameIn))

    m_row = sheet_obj.max_row
    m_col = sheet_obj.max_column

    listOut = []

    for i in range(1, m_row +1):
        listTemp = []
        for j in range(1, m_col + 1):
            cell_obj = sheet_obj.cell(row=i, column=j)
            listTemp.append(cell_obj.value)
            if len(listTemp) == m_col:
                listOut.append(listTemp)
    return listOut

def getUsedFamilyTypeOfModeling(elements):
    familyCode = list(map(lambda x: x.Name.split('_')[0], elements))
    unq_familyCode = findUnique(familyCode)
    return unq_familyCode
    
def createExcelDataDictionary(values):
    result = {}
    for i in range(len(values)):
        result[str(i)] = values[i]
    return result

def findTargetIndex(targets, list):
    result = []
    for target in targets:
        for i in range(len(list)):
            if target in str(list[i]):
                result.append(i)
            else:
                pass
    result.sort()
    return result
    
def GetValueAtKeys(keys, dictionary):
    result = [] 
    for i in keys:
        result.append(dictionary[str(i)])
    return result


# Place your code below this line
element = inputDict["AllElement"]
elementType = []
for i in element:
    elementType.append(i.Name)
familyCode = []
for i in elementType:
    familyCode.append(i.split("_")[0])
fullWMCodeDescriptionPerElement = inputDict["FullWMCodeDescriptionPerElement"]

resultDict = {
"Element": element,
"ElementType": elementType,
"FamilyCode": familyCode,
"FullWMCodeDescriptionPerElement": fullWMCodeDescriptionPerElement
}



result = resultDict

# Assign your output to the OUT variable.
OUT = result
# ----------------------------------------

# group: Select Target Family Element And Connected WorkMasters
code_block_255 = CodeBlock { 0; }
select_target_family_element_and = Python(IN[0]=set_up_all_element_inform_as, IN[1]=code_block_255)  # "Select Target Family Element And Connected WorkMasters"; CPython3
# ---------- select_target_family_element_and.python (138 lines) ----------
# Load the Python Standard and DesignScript Libraries
import os
import sys
sys.path.append(os.getenv('LOCALAPPDATA').replace('\\','\\\\') + r'\Programs\Python\Python39\Lib\site-packages')
import clr
clr.AddReference('RevitAPI')
import Autodesk

clr.AddReference('ProtoGeometry')
from Autodesk.DesignScript.Geometry import *

clr.AddReference('RevitNodes')
import Revit
clr.ImportExtensions(Revit.Elements)

clr.ImportExtensions(Revit.GeometryConversion)
clr.ImportExtensions(Revit.GeometryReferences)

clr.AddReference('RevitServices')
import RevitServices
from RevitServices.Persistence import DocumentManager
from RevitServices.Transactions import TransactionManager

doc = DocumentManager.Instance.CurrentDBDocument

import random
import itertools
from functools import reduce
from collections import Iterable
import datetime
import openpyxl

def iterable(obj):
    return isinstance(obj, Iterable)

def findUnique(inputs):
    result = []
    for i in inputs:
        if i in result:
            pass
        else:
            result.append(i)
    return result

# The inputs to this node will be stored as a list in the IN variables.
dataEnteringNode = IN
inputDict = IN[0]
inputIndex = IN[1]


def importExcel(path, SheetNameIn):
    wb_obj = openpyxl.load_workbook(str(path), data_only=True)
    sheet_obj = wb_obj.get_sheet_by_name(str(SheetNameIn))

    m_row = sheet_obj.max_row
    m_col = sheet_obj.max_column

    listOut = []

    for i in range(1, m_row +1):
        listTemp = []
        for j in range(1, m_col + 1):
            cell_obj = sheet_obj.cell(row=i, column=j)
            listTemp.append(cell_obj.value)
            if len(listTemp) == m_col:
                listOut.append(listTemp)
    return listOut

def getUsedFamilyTypeOfModeling(elements):
    familyCode = list(map(lambda x: x.Name.split('_')[0], elements))
    unq_familyCode = findUnique(familyCode)
    return unq_familyCode
    
def createExcelDataDictionary(values):
    result = {}
    for i in range(len(values)):
        result[str(i)] = values[i]
    return result

def findTargetIndex(targets, list):
    result = []
    for target in targets:
        for i in range(len(list)):
            if target in str(list[i]):
                result.append(i)
            else:
                pass
    result.sort()
    return result
    
def GetValueAtKeys(keys, dictionary):
    result = [] 
    for i in keys:
        result.append(dictionary[str(i)])
    return result


# Place your code below this line
fullWMCodeDescriptionPerElement = inputDict["FullWMCodeDescriptionPerElement"]
element = inputDict["Element"]
familyCode = inputDict["FamilyCode"]
familyCode_unique = findUnique(familyCode)
targetFamilyCode = familyCode_unique[inputIndex]
targetIndex = []
for i in range(len(familyCode)):
    if targetFamilyCode in familyCode[i]:
        targetIndex.append(i)
    else:
        pass

targetElements = []
for i in targetIndex:
    targetElements.append(element[i])

targetFamilyCode = []
for i in targetIndex:
    targetFamilyCode.append(element[i].Name)

WMforTargetElements = []
for i in targetIndex:
    WMforTargetElements.append(fullWMCodeDescriptionPerElement[i])

WMforTargetElements_flat = list(itertools.chain(*WMforTargetElements))
targetWMunique = findUnique(WMforTargetElements_flat)

resultDict = {
"TargetElements": targetElements,
"TargetFamilyCode": targetFamilyCode,
"WMforTargetElements": WMforTargetElements,
"TargetWMunique": targetWMunique
}



result = resultDict

# Assign your output to the OUT variable.
OUT = result
# ----------------------------------------

watch_17 = Watch(select_target_family_element_and)

# group: Select Target Family Element And Connected WorkMasters
code_block_256 = CodeBlock { 1; }
select_target_family_element_and_2 = Python(IN[0]=set_up_all_element_inform_as, IN[1]=code_block_256)  # "Select Target Family Element And Connected WorkMasters"; CPython3; same code as select_target_family_element_and

watch_18 = Watch(select_target_family_element_and_2)

# group: Select Target Family Element And Connected WorkMasters
code_block_257 = CodeBlock { 2; }
select_target_family_element_and_3 = Python(IN[0]=set_up_all_element_inform_as, IN[1]=code_block_257)  # "Select Target Family Element And Connected WorkMasters"; CPython3; same code as select_target_family_element_and

watch_19 = Watch(select_target_family_element_and_3)

# group: Select Target Family Element And Connected WorkMasters
code_block_258 = CodeBlock { 3; }
select_target_family_element_and_4 = Python(IN[0]=set_up_all_element_inform_as, IN[1]=code_block_258)  # "Select Target Family Element And Connected WorkMasters"; CPython3; same code as select_target_family_element_and

watch_20 = Watch(select_target_family_element_and_4)

# group: Visual Manager
visual_켜기_끄기_14 = BoolSelector(false)
visual_manager_14 = Python(IN[0]=output_35.RefOutput_geoColor, IN[1]=visual_켜기_끄기_14)  # CPython3; same code as visual_manager

# group: 사용된 패밀리 타입 종류 확인 구간
code_block_259 = CodeBlock { "ElementType"; }
valueAtKey_51 = DesignScript.Builtin.Dictionary.ValueAtKey(dictionary=set_up_all_element_inform_as, key=code_block_259)
uniqueItems_2 = List.UniqueItems(list=valueAtKey_51)
watch_21 = Watch(uniqueItems_2)
code_block_260 = CodeBlock { "FamilyCode"; }
valueAtKey_52 = DesignScript.Builtin.Dictionary.ValueAtKey(dictionary=set_up_all_element_inform_as, key=code_block_260)
uniqueItems_3 = List.UniqueItems(list=valueAtKey_52)
watch_22 = Watch(uniqueItems_3)

# group: Primary Input : Excel & Revit Elements
categories_3 = Categories("OST_EdgeSlab")
all_elements_of_category_3 = ElementsOfCategory(Category=categories_3)
string_from_web_2 = Python()  # CPython3; unwired: IN[0]; same code as string_from_web
file_path_2 = Filename("..\DMS(Data Matching Schedule)_R0(Seq1-2).xlsx")  # graph input
sheet_name_2 = CodeBlock { "Slab Edges"; }
github_python_import_excel_by_2 = PythonStringNode(script=string_from_web_2, IN[0]=file_path_2, IN[1]=sheet_name_2)  # "Github_Python@Import Excel(By OpenpyXl)"; CPython3
code_block_261 = CodeBlock(InputElement=all_elements_of_category_3, InputData=github_python_import_excel_by_2) { _InputElement; _InputData; }

# group: GetFull WMCodeDescription PerElement
excelDataManagerNode_2 = Python(IN[0]=code_block_261._InputElement, IN[1]=code_block_261._InputData)  # CPython3; same code as excelDataManagerNode

# group: Organize AllElementInform AsDictionary
set_up_all_element_inform_as_2 = Python(IN[0]=excelDataManagerNode_2)  # "Set Up All Element Inform as Dictionary"; CPython3; same code as set_up_all_element_inform_as

# group: 사용된 패밀리 타입 종류 확인 구간
code_block_262 = CodeBlock { "FamilyCode"; }
valueAtKey_53 = DesignScript.Builtin.Dictionary.ValueAtKey(dictionary=set_up_all_element_inform_as_2, key=code_block_262)
uniqueItems_4 = List.UniqueItems(list=valueAtKey_53)
watch_23 = Watch(uniqueItems_4)
code_block_263 = CodeBlock { "ElementType"; }
valueAtKey_54 = DesignScript.Builtin.Dictionary.ValueAtKey(dictionary=set_up_all_element_inform_as_2, key=code_block_263)
uniqueItems_5 = List.UniqueItems(list=valueAtKey_54)
watch_24 = Watch(uniqueItems_5)

# group: Select Target Family Element And Connected WorkMasters
code_block_264 = CodeBlock { 0; }
select_target_family_element_and_5 = Python(IN[0]=set_up_all_element_inform_as_2, IN[1]=code_block_264)  # "Select Target Family Element And Connected WorkMasters"; CPython3; same code as select_target_family_element_and

code_block_265 = CodeBlock(i=select_target_family_element_and_5) { i; }

# group: Input Manager
value_for_import_from_others_52 = CodeBlock(MainInput=code_block_265) { MainInput; RefInput1; RefInput2; }  # unwired: RefInput1, RefInput2

# group: <Func 2> Excavation for Slab edge (ratio 1.1 적용)
code_block_266 = CodeBlock { "TargetElements"; }
valueAtKey_55 = DesignScript.Builtin.Dictionary.ValueAtKey(dictionary=value_for_import_from_others_52.MainInput, key=code_block_266)

code_block_267 = CodeBlock { "Volume"; }
getParameterValueByName_14 = Element.GetParameterValueByName(element=valueAtKey_55, parameterName=code_block_267)
code_block_268 = CodeBlock(i=getParameterValueByName_14) { Math.Round(List.Flatten(i)*1.1, 2); }
code_block_269 = CodeBlock { "M3"; }
count_53 = List.Count(list=code_block_268)
ofRepeatedItem_46 = List.OfRepeatedItem(item=code_block_269, amount=count_53)
code_block_270 = CodeBlock(FuncValues=code_block_268, FuncValuesUnit=ofRepeatedItem_46)  # same code as code_block_6

# group (continued): <Func 2> Excavation for Slab edge (ratio 1.1 적용)
forRefOutput_6 = CodeBlock(MainOutput=code_block_270)  # unwired: geoColor, 터파기형상; same code as forRefOutput

# group: Output Manager
output_45 = CodeBlock(MainOutput=forRefOutput_6) { MainOutput; RefOutput_geoColor; }  # unwired: RefOutput_geoColor
reference_output_45 = CodeBlock(ref=code_block_268, ref2=getParameterValueByName_14) { ref; ref2; }

watch_25 = Watch(output_45.MainOutput)
# group: Input Manager
value_for_import_from_others_53 = CodeBlock(MainInput=code_block_265) { MainInput; RefInput1; RefInput2; }  # unwired: RefInput1, RefInput2

# group: <Func 1> Structural Concrete
code_block_271 = CodeBlock { "TargetElements"; }
valueAtKey_56 = DesignScript.Builtin.Dictionary.ValueAtKey(dictionary=value_for_import_from_others_53.MainInput, key=code_block_271)
# note: <Func>
geometry_6 = Element.Geometry(element=valueAtKey_56)
volume_22 = Solid.Volume(solid=geometry_6)
code_block_272 = CodeBlock(i=volume_22) { Math.Round(List.Flatten(i)/1000000000,2); }
code_block_273 = CodeBlock { "M3"; }
count_54 = List.Count(list=code_block_272)
ofRepeatedItem_47 = List.OfRepeatedItem(item=code_block_273, amount=count_54)
code_block_274 = CodeBlock(FuncValues=code_block_272, FuncValuesUnit=ofRepeatedItem_47)  # same code as code_block_6

# group: Output Manager
reference_output_46 = CodeBlock(ref=geometry_6) { ref; }
output_46 = CodeBlock(MainOutput=code_block_274) { MainOutput; RefOutput_geoColor; }  # unwired: RefOutput_geoColor

watch_26 = Watch(select_target_family_element_and_5)

# group: Input Manager
value_for_import_from_others_54 = CodeBlock(MainInput=code_block_265) { MainInput; RefInput1; RefInput2; }  # unwired: RefInput1, RefInput2

# group: <Func 5> Form Works (Ground Slab 거푸집 필요X)
code_block_275 = CodeBlock { "TargetElements"; }
# note: <Func>
valueAtKey_57 = DesignScript.Builtin.Dictionary.ValueAtKey(dictionary=value_for_import_from_others_54.MainInput, key=code_block_275)
code_block_276 = CodeBlock { "M2"; }

extractSideFacesOfElement_3 = Custom[ExtractSideFacesOfElement](Element=valueAtKey_57)
area_14 = Surface.Area(surface=extractSideFacesOfElement_3.Surface)
sum_6 = Math.Sum(values=area_14)

# group (continued): <Func 5> Form Works (Ground Slab 거푸집 필요X)
code_block_277 = CodeBlock(i=sum_6) { Math.Round(List.Flatten(i)/1000000,2); }
count_55 = List.Count(list=code_block_277)
ofRepeatedItem_48 = List.OfRepeatedItem(item=code_block_276, amount=count_55)
code_block_278 = CodeBlock(FuncValues=code_block_277, FuncValuesUnit=ofRepeatedItem_48)  # same code as code_block_6

# group: Output Manager
output_47 = CodeBlock(MainOutput=code_block_278) { MainOutput; RefOutput_geoColor; }  # unwired: RefOutput_geoColor
reference_output_47 = CodeBlock { ref; }  # unwired: ref

# group: Input Manager
value_for_import_from_others_55 = CodeBlock(MainInput=code_block_265, RefInput1=reference_output_45.ref2) { MainInput; RefInput1; RefInput2; }  # unwired: RefInput2

# group: <Func 4>Disposal
code_block_279 = CodeBlock(i=value_for_import_from_others_55.RefInput1) { Math.Round(List.Flatten(i), 2); }
code_block_280 = CodeBlock { "M3"; }
count_56 = List.Count(list=code_block_279)
ofRepeatedItem_49 = List.OfRepeatedItem(item=code_block_280, amount=count_56)
code_block_281 = CodeBlock(FuncValues=code_block_279, FuncValuesUnit=ofRepeatedItem_49)  # same code as code_block_6

# group: Output Manager
reference_output_48 = CodeBlock(ref=code_block_279) { ref; }
output_48 = CodeBlock(MainOutput=code_block_281) { MainOutput; RefOutput_geoColor; }  # unwired: RefOutput_geoColor

# group: Input Manager
value_for_import_from_others_56 = CodeBlock(MainInput=code_block_265, RefInput1=reference_output_45.ref, RefInput2=reference_output_48) { MainInput; RefInput1; RefInput2; RefInput3; }  # unwired: RefInput3

# group: <Func 3> Backfill
value_for_import_from_others_57 = CodeBlock(Excavation=value_for_import_from_others_56.RefInput1) { Excavation; }
value_for_import_from_others_58 = CodeBlock(Disposal=value_for_import_from_others_56.RefInput2) { Disposal; }
code_block_282 = CodeBlock { "M3"; }

sub_6 = value_for_import_from_others_57 - value_for_import_from_others_58

# group (continued): <Func 3> Backfill
watch_27 = Watch(sub_6)
code_block_283 = CodeBlock(i=watch_27) { Math.Round(List.Flatten(i)/1000000000, 2); }
count_57 = List.Count(list=watch_27)
ofRepeatedItem_50 = List.OfRepeatedItem(item=code_block_282, amount=count_57)
# note: 터파기 물량ㅈ에서 콘크리트, 린 기둥 물량 빼기
code_block_284 = CodeBlock(FuncValues=code_block_283, FuncValuesUnit=ofRepeatedItem_50)  # same code as code_block_6

# group: Output Manager
output_49 = CodeBlock(MainOutput=code_block_284) { MainOutput; RefOutput_geoColor; }  # unwired: RefOutput_geoColor
reference_output_49 = CodeBlock { ref; }  # unwired: ref

# group: Input Manager
value_for_import_from_others_59 = CodeBlock(MainInput=code_block_265) { MainInput; RefInput1; RefInput2; }  # unwired: RefInput1, RefInput2

# group: <Func 6>Rebar Work
code_block_285 = CodeBlock { "TargetElements"; }
valueAtKey_58 = DesignScript.Builtin.Dictionary.ValueAtKey(dictionary=value_for_import_from_others_59.MainInput, key=code_block_285)
code_block_286 = CodeBlock { "Volume"; }
# note: <Func>
getParameterValueByName_15 = Element.GetParameterValueByName(element=valueAtKey_58, parameterName=code_block_286)
slab_edge_철근비 = DoubleInput(0)  # graph input
mul_5 = getParameterValueByName_15 * slab_edge_철근비
code_block_287 = CodeBlock(i=mul_5) { Math.Round(List.Flatten(i)/1, 2); }
code_block_288 = CodeBlock { "TON"; }
count_58 = List.Count(list=code_block_287)
ofRepeatedItem_51 = List.OfRepeatedItem(item=code_block_288, amount=count_58)
code_block_289 = CodeBlock(FuncValues=code_block_287, FuncValuesUnit=ofRepeatedItem_51)  # same code as code_block_6

# group: Output Manager
output_50 = CodeBlock(MainOutput=code_block_289) { MainOutput; RefOutput_geoColor; }  # unwired: RefOutput_geoColor
reference_output_50 = CodeBlock { ref; }  # unwired: ref

join_5 = List.Join(list1=output_46.MainOutput, list2=output_47.MainOutput, list4=output_45.MainOutput, list5=output_49.MainOutput, list6=output_48.MainOutput, list10=output_50.MainOutput)  # unwired: list0, list3, list7, list8, list9

# group: Visual Manager
visual_켜기_끄기_15 = BoolSelector(false)
visual_manager_15 = Python(IN[0]=output_45.RefOutput_geoColor, IN[1]=visual_켜기_끄기_15)  # CPython3; same code as visual_manager
