# Dynamo graph 06 Wall (220104).dyn (Dynamo 2.12.0.5650)

# group: Primary Input : Excel & Revit Elements
categories = Categories("OST_Walls")
all_elements_of_category = ElementsOfCategory(Category=categories)
string_from_web = Python()  # CPython3; unwired: IN[0]
# ---------- string_from_web.python (19 lines) ----------
# Load the Python Standard and DesignScript Libraries
import sys
import clr
clr.AddReference('ProtoGeometry')
from Autodesk.DesignScript.Geometry import *
import urllib.request

# The inputs to this node will be stored as a list in the IN variables.
dataEnteringNode = IN
inputURL = "https://raw.githubusercontent.com/HNANmal/mQ/master/Hdynlib/General/ImportExcel.py"

# Place your code below this line
req = urllib.request
data = req.urlopen(inputURL)

result = data.read().decode("utf-8")

# Assign your output to the OUT variable.
OUT = result
# ----------------------------------------
file_path = Filename("..\DMS(Data Matching Schedule)_R0(Seq1-2).xlsx")  # graph input
sheet_name = CodeBlock { "Walls"; }
github_python_import_excel_by = PythonStringNode(script=string_from_web, IN[0]=file_path, IN[1]=sheet_name)  # "Github_Python@Import Excel(By OpenpyXl)"; CPython3
code_block = CodeBlock(InputElement=all_elements_of_category, InputData=github_python_import_excel_by) { _InputElement; _InputData; }

# group: GetFull WMCodeDescription PerElement
excelDataManagerNode = Python(IN[0]=code_block._InputElement, IN[1]=code_block._InputData)  # CPython3
# ---------- excelDataManagerNode.python (279 lines) ----------
# Load the Python Standard and DesignScript Libraries
import os
import sys
sys.path.append(os.getenv('LOCALAPPDATA').replace('\\','\\\\') + r'\Programs\Python\Python39\Lib\site-packages')
import clr
clr.AddReference('RevitAPI')
import Autodesk

clr.AddReference('ProtoGeometry')
from Autodesk.DesignScript.Geometry import *

clr.AddReference('RevitNodes')
import Revit
clr.ImportExtensions(Revit.Elements)

clr.ImportExtensions(Revit.GeometryConversion)
clr.ImportExtensions(Revit.GeometryReferences)

clr.AddReference('RevitServices')
import RevitServices
from RevitServices.Persistence import DocumentManager
from RevitServices.Transactions import TransactionManager

doc = DocumentManager.Instance.CurrentDBDocument

import random
import itertools
from functools import reduce
from collections import Iterable
import datetime
import openpyxl

def iterable(obj):
    return isinstance(obj, Iterable)

def findUnique(inputs):
    result = []
    for i in inputs:
        if i in result:
            pass
        else:
            result.append(i)
    return result

# The inputs to this node will be stored as a list in the IN variables.
dataEnteringNode = IN
inputElements = IN[0]
inputData = IN[1]
#inputSheetName = IN[2]

def importExcel(path, SheetNameIn):
    wb_obj = openpyxl.load_workbook(str(path), data_only=True)
    sheet_obj = wb_obj.get_sheet_by_name(str(SheetNameIn))

    m_row = sheet_obj.max_row
    m_col = sheet_obj.max_column

    listOut = []

    for i in range(1, m_row +1):
        listTemp = []
        for j in range(1, m_col + 1):
            cell_obj = sheet_obj.cell(row=i, column=j)
            listTemp.append(cell_obj.value)
            if len(listTemp) == m_col:
                listOut.append(listTemp)
    return listOut

def getUsedFamilyTypeOfModeling(elements):
    familyCode = list(map(lambda x: x.Name.split('_')[0], elements))
    unq_familyCode = findUnique(familyCode)
    return unq_familyCode
    
def createExcelDataDictionary(values):
    result = {}
    for i in range(len(values)):
        result[str(i)] = values[i]
    return result

def findTargetIndex(targets, list):
    result = []
    for target in targets:
        for i in range(len(list)):
            if target in str(list[i]):
                result.append(i)
            else:
                pass
    result.sort()
    return result
    
def GetValueAtKeys(keys, dictionary):
    result = [] 
    for i in keys:
        result.append(dictionary[str(i)])
    return result


# Place your code below this line
usedFamilyTypeOfModeling = getUsedFamilyTypeOfModeling(inputElements)
excelWholeDataSet = inputData#importExcel(inputFilePath, inputSheetName)
trExcelWholeDataSet = list(zip(*excelWholeDataSet))
excelColumnDataSet = createExcelDataDictionary(trExcelWholeDataSet)
excelRowDataSet = createExcelDataDictionary(excelWholeDataSet)
ColumnIndexOfUsedFamilyType = findTargetIndex(usedFamilyTypeOfModeling, trExcelWholeDataSet)
ColDataSetOfUsedFamilyType = GetValueAtKeys(ColumnIndexOfUsedFamilyType, excelColumnDataSet)
materialPerElementFromModeling = []
for i in inputElements:
    materialPerElementFromModeling.append(i.GetMaterials())
#list(map(lambda x: x.GetMaterials, inputElements)) "맵함수로 처리하면 리스트화 할 때 타입 변환 오류 남"

targetWMRowIndex = []
for i in ColDataSetOfUsedFamilyType:
    targetWMRowIndex.append(findTargetIndex(['000'], i))

rowDataSetOfUsedWM = []
for i in targetWMRowIndex:
    rowDataSetOfUsedWM.append(GetValueAtKeys(i, excelRowDataSet))

workGroup = []
for i in rowDataSetOfUsedWM:
    tmp = []
    for j in i:
        tmp.append(j[0])
    workGroup.append(tmp)
    
workMaster = []
for i in range(len(ColDataSetOfUsedFamilyType)):
    tmp=[]
    for k in targetWMRowIndex[i]:
        tmp.append(ColDataSetOfUsedFamilyType[i][k])
    workMaster.append(tmp)

matchedWM = []
for i in range(len(workGroup)):
    tmp = []
    for j in range(len(workGroup[i])):
        fullWM = workGroup[i][j] +"-"+ workMaster[i][j]
        tmp.append(fullWM)
    matchedWM.append(tmp)

matchedWorkGruopAndMasterCode = []
for i in matchedWM:
    if len(i) > 0:
        matchedWorkGruopAndMasterCode.append(i)
    else:
        pass

matchedWMDescription = []
for i in rowDataSetOfUsedWM:
    tmp=[]
    for j in i:
        tmp.append(j[1] +" "+ j[2] +" "+ j[3] +" "+ "("+ j[4] +")")
    if len(tmp) > 0:
        matchedWMDescription.append(tmp)
    else:
        pass

matchedWMUnit = []
for i in rowDataSetOfUsedWM:
    tmp=[]
    for j in i:
        tmp.append(j[4])
    if len(tmp) > 0:
        matchedWMUnit.append(tmp)
    else:
        pass

matchedWorkGruopAndMasterCode_flat = list(itertools.chain(*matchedWorkGruopAndMasterCode))
matchedWMDescription_flat = list(itertools.chain(*matchedWMDescription))

dic_WMandDescription_Excel = {}
for i in range(len(matchedWorkGruopAndMasterCode_flat)):
    dic_WMandDescription_Excel[matchedWorkGruopAndMasterCode_flat[i]] = matchedWMDescription_flat[i]

usedFamilyTypeInExcelOrder = list(map(lambda x: x[3], ColDataSetOfUsedFamilyType))
usedFamilyCodeInExcelOrder = findUnique(list(map(lambda x: x.split('_')[0], usedFamilyTypeInExcelOrder)))

dic_FamilyCodeandWM = {}
for i in range(len(usedFamilyCodeInExcelOrder)):
    dic_FamilyCodeandWM[usedFamilyCodeInExcelOrder[i]] = matchedWorkGruopAndMasterCode[i]

workMasterCodePerElement = []
familyCodePerElem = list(map(lambda x: x.Name.split('_')[0], inputElements))
for i in familyCodePerElem:
    workMasterCodePerElement.append(dic_FamilyCodeandWM[i])

materialNamePerElem = []
for i in materialPerElementFromModeling:
    tmp = []
    for j in i:
        tmp.append(j.Name)
    materialNamePerElem.append(tmp)

WMPerElementFromModeling = []
for i in materialNamePerElem:
    tmp = []
    for j in i:
        tmp.append(j.split('_')[0])
    WMPerElementFromModeling.append(tmp)

specPerElementFromModeling = []
for i in materialNamePerElem:
    tmp = []
    for j in i:
        a = j.split('_')
        del a[0]
        b = " ".join(a)
        tmp.append(b)
    specPerElementFromModeling.append(tmp)

WMPerElementFromModeling_flat = list(itertools.chain(*WMPerElementFromModeling))
specPerElementFromModeling_flat = list(itertools.chain(*specPerElementFromModeling))

dic_WMandDescription_Model = {}
for i in range(len(WMPerElementFromModeling_flat)):
    dic_WMandDescription_Model[WMPerElementFromModeling_flat[i]] = specPerElementFromModeling_flat[i]

def findAllKeys(dict):
    result = []
    for key in dict.keys():
        result.append(key)
    return result

def findAllValues(dict):
    result = []
    for key in dict.keys():
        result.append(dict[key])
    return result

keys_WMandDescription_Model = findAllKeys(dic_WMandDescription_Model)
keys_WMandDescription_Excel = findAllKeys(dic_WMandDescription_Excel)

keys_WMandDescription_Both = list(set(keys_WMandDescription_Model + keys_WMandDescription_Excel))
values_WMandDescription_Both = []
for i in keys_WMandDescription_Both:
    if i in keys_WMandDescription_Model:
        values_WMandDescription_Both.append(dic_WMandDescription_Model[i])
    else:
        values_WMandDescription_Both.append(dic_WMandDescription_Excel[i])

dic_WMandDescription_Both = {}
for i in range(len(keys_WMandDescription_Both)):
    dic_WMandDescription_Both[keys_WMandDescription_Both[i]] = values_WMandDescription_Both[i]

workMasterCodePerElementFromBoth = []
for i in range(len(workMasterCodePerElement)):
    #tmp = []
    a = WMPerElementFromModeling[i] + workMasterCodePerElement[i]
    b = findUnique(a)
    workMasterCodePerElementFromBoth.append(b)

specPerElement = []
for i in workMasterCodePerElementFromBoth:
    tmp = []
    for j in i:
        tmp.append(dic_WMandDescription_Both[j])
    specPerElement.append(tmp)

fullWMCodeDescriptionPerElement = []
for i in range(len(workMasterCodePerElementFromBoth)):
    tmp = []
    for j in range(len(workMasterCodePerElementFromBoth[i])):
        a = workMasterCodePerElementFromBoth[i][j] +": "+ specPerElement[i][j]
        tmp.append(a)
    fullWMCodeDescriptionPerElement.append(tmp)

fullWMinfo = {
"AllElement": inputElements,
"WorkMasterCodePerFamilyType": dic_FamilyCodeandWM,
"WorkMasterCodePerElementBoth": workMasterCodePerElementFromBoth,
"FullWMCodeDescriptionPerElement": fullWMCodeDescriptionPerElement
}



result = fullWMinfo

# Assign your output to the OUT variable.
OUT = result
# ----------------------------------------

# group: Organize AllElementInform AsDictionary
set_up_all_element_inform_as = Python(IN[0]=excelDataManagerNode)  # "Set Up All Element Inform as Dictionary"; CPython3
# ---------- set_up_all_element_inform_as.python (119 lines) ----------
# Load the Python Standard and DesignScript Libraries
import os
import sys
sys.path.append(os.getenv('LOCALAPPDATA').replace('\\','\\\\') + r'\Programs\Python\Python39\Lib\site-packages')
import clr
clr.AddReference('RevitAPI')
import Autodesk

clr.AddReference('ProtoGeometry')
from Autodesk.DesignScript.Geometry import *

clr.AddReference('RevitNodes')
import Revit
clr.ImportExtensions(Revit.Elements)

clr.ImportExtensions(Revit.GeometryConversion)
clr.ImportExtensions(Revit.GeometryReferences)

clr.AddReference('RevitServices')
import RevitServices
from RevitServices.Persistence import DocumentManager
from RevitServices.Transactions import TransactionManager

doc = DocumentManager.Instance.CurrentDBDocument

import random
import itertools
from functools import reduce
from collections import Iterable
import datetime
import openpyxl

def iterable(obj):
    return isinstance(obj, Iterable)

def findUnique(inputs):
    result = []
    for i in inputs:
        if i in result:
            pass
        else:
            result.append(i)
    return result

# The inputs to this node will be stored as a list in the IN variables.
dataEnteringNode = IN
inputDict = IN[0]


def importExcel(path, SheetNameIn):
    wb_obj = openpyxl.load_workbook(str(path), data_only=True)
    sheet_obj = wb_obj.get_sheet_by_name(str(SheetNameIn))

    m_row = sheet_obj.max_row
    m_col = sheet_obj.max_column

    listOut = []

    for i in range(1, m_row +1):
        listTemp = []
        for j in range(1, m_col + 1):
            cell_obj = sheet_obj.cell(row=i, column=j)
            listTemp.append(cell_obj.value)
            if len(listTemp) == m_col:
                listOut.append(listTemp)
    return listOut

def getUsedFamilyTypeOfModeling(elements):
    familyCode = list(map(lambda x: x.Name.split('_')[0], elements))
    unq_familyCode = findUnique(familyCode)
    return unq_familyCode
    
def createExcelDataDictionary(values):
    result = {}
    for i in range(len(values)):
        result[str(i)] = values[i]
    return result

def findTargetIndex(targets, list):
    result = []
    for target in targets:
        for i in range(len(list)):
            if target in str(list[i]):
                result.append(i)
            else:
                pass
    result.sort()
    return result
    
def GetValueAtKeys(keys, dictionary):
    result = [] 
    for i in keys:
        result.append(dictionary[str(i)])
    return result


# Place your code below this line
element = inputDict["AllElement"]
elementType = []
for i in element:
    elementType.append(i.Name)
familyCode = []
for i in elementType:
    familyCode.append(i.split("_")[0])
fullWMCodeDescriptionPerElement = inputDict["FullWMCodeDescriptionPerElement"]

resultDict = {
"Element": element,
"ElementType": elementType,
"FamilyCode": familyCode,
"FullWMCodeDescriptionPerElement": fullWMCodeDescriptionPerElement
}



result = resultDict

# Assign your output to the OUT variable.
OUT = result
# ----------------------------------------

# group: Select Target Family Element And Connected WorkMasters
code_block_2 = CodeBlock { 0; }
select_target_family_element_and = Python(IN[0]=set_up_all_element_inform_as, IN[1]=code_block_2)  # "Select Target Family Element And Connected WorkMasters"; CPython3
# ---------- select_target_family_element_and.python (138 lines) ----------
# Load the Python Standard and DesignScript Libraries
import os
import sys
sys.path.append(os.getenv('LOCALAPPDATA').replace('\\','\\\\') + r'\Programs\Python\Python39\Lib\site-packages')
import clr
clr.AddReference('RevitAPI')
import Autodesk

clr.AddReference('ProtoGeometry')
from Autodesk.DesignScript.Geometry import *

clr.AddReference('RevitNodes')
import Revit
clr.ImportExtensions(Revit.Elements)

clr.ImportExtensions(Revit.GeometryConversion)
clr.ImportExtensions(Revit.GeometryReferences)

clr.AddReference('RevitServices')
import RevitServices
from RevitServices.Persistence import DocumentManager
from RevitServices.Transactions import TransactionManager

doc = DocumentManager.Instance.CurrentDBDocument

import random
import itertools
from functools import reduce
from collections import Iterable
import datetime
import openpyxl

def iterable(obj):
    return isinstance(obj, Iterable)

def findUnique(inputs):
    result = []
    for i in inputs:
        if i in result:
            pass
        else:
            result.append(i)
    return result

# The inputs to this node will be stored as a list in the IN variables.
dataEnteringNode = IN
inputDict = IN[0]
inputIndex = IN[1]


def importExcel(path, SheetNameIn):
    wb_obj = openpyxl.load_workbook(str(path), data_only=True)
    sheet_obj = wb_obj.get_sheet_by_name(str(SheetNameIn))

    m_row = sheet_obj.max_row
    m_col = sheet_obj.max_column

    listOut = []

    for i in range(1, m_row +1):
        listTemp = []
        for j in range(1, m_col + 1):
            cell_obj = sheet_obj.cell(row=i, column=j)
            listTemp.append(cell_obj.value)
            if len(listTemp) == m_col:
                listOut.append(listTemp)
    return listOut

def getUsedFamilyTypeOfModeling(elements):
    familyCode = list(map(lambda x: x.Name.split('_')[0], elements))
    unq_familyCode = findUnique(familyCode)
    return unq_familyCode
    
def createExcelDataDictionary(values):
    result = {}
    for i in range(len(values)):
        result[str(i)] = values[i]
    return result

def findTargetIndex(targets, list):
    result = []
    for target in targets:
        for i in range(len(list)):
            if target in str(list[i]):
                result.append(i)
            else:
                pass
    result.sort()
    return result
    
def GetValueAtKeys(keys, dictionary):
    result = [] 
    for i in keys:
        result.append(dictionary[str(i)])
    return result


# Place your code below this line
fullWMCodeDescriptionPerElement = inputDict["FullWMCodeDescriptionPerElement"]
element = inputDict["Element"]
familyCode = inputDict["FamilyCode"]
familyCode_unique = findUnique(familyCode)
targetFamilyCode = familyCode_unique[inputIndex]
targetIndex = []
for i in range(len(familyCode)):
    if targetFamilyCode in familyCode[i]:
        targetIndex.append(i)
    else:
        pass

targetElements = []
for i in targetIndex:
    targetElements.append(element[i])

targetFamilyCode = []
for i in targetIndex:
    targetFamilyCode.append(element[i].Name)

WMforTargetElements = []
for i in targetIndex:
    WMforTargetElements.append(fullWMCodeDescriptionPerElement[i])

WMforTargetElements_flat = list(itertools.chain(*WMforTargetElements))
targetWMunique = findUnique(WMforTargetElements_flat)

resultDict = {
"TargetElements": targetElements,
"TargetFamilyCode": targetFamilyCode,
"WMforTargetElements": WMforTargetElements,
"TargetWMunique": targetWMunique
}



result = resultDict

# Assign your output to the OUT variable.
OUT = result
# ----------------------------------------

watch = Watch(select_target_family_element_and)

# group: Select Target Family Element And Connected WorkMasters
code_block_3 = CodeBlock { 1; }
select_target_family_element_and_2 = Python(IN[0]=set_up_all_element_inform_as, IN[1]=code_block_3)  # "Select Target Family Element And Connected WorkMasters"; CPython3; same code as select_target_family_element_and

watch_2 = Watch(select_target_family_element_and_2)

# group: Select Target Family Element And Connected WorkMasters
code_block_4 = CodeBlock { 2; }
select_target_family_element_and_3 = Python(IN[0]=set_up_all_element_inform_as, IN[1]=code_block_4)  # "Select Target Family Element And Connected WorkMasters"; CPython3; same code as select_target_family_element_and

watch_3 = Watch(select_target_family_element_and_3)

# group: Select Target Family Element And Connected WorkMasters
code_block_5 = CodeBlock { 3; }
select_target_family_element_and_4 = Python(IN[0]=set_up_all_element_inform_as, IN[1]=code_block_5)  # "Select Target Family Element And Connected WorkMasters"; CPython3; same code as select_target_family_element_and

watch_4 = Watch(select_target_family_element_and_4)

# group: Select Target Family Element And Connected WorkMasters
code_block_6 = CodeBlock { 4; }
select_target_family_element_and_5 = Python(IN[0]=set_up_all_element_inform_as, IN[1]=code_block_6)  # "Select Target Family Element And Connected WorkMasters"; CPython3; same code as select_target_family_element_and

watch_5 = Watch(select_target_family_element_and_5)
code_block_7 = CodeBlock(i=select_target_family_element_and) { i; }

# group: Input Manager
value_for_import_from_others = CodeBlock(MainInput=code_block_7) { MainInput; RefInput1; RefInput2; }  # unwired: RefInput1, RefInput2

# group: <Func 1> Structural Concrete
code_block_8 = CodeBlock { "TargetElements"; }
valueAtKey = DesignScript.Builtin.Dictionary.ValueAtKey(dictionary=value_for_import_from_others.MainInput, key=code_block_8)
# note: <Func>
geometry = Element.Geometry(element=valueAtKey)
volume = Solid.Volume(solid=geometry)
code_block_9 = CodeBlock(i=volume) { Math.Round(List.Flatten(i)/1000000000,2); }
code_block_10 = CodeBlock { "M3"; }
count = List.Count(list=code_block_9)
ofRepeatedItem = List.OfRepeatedItem(item=code_block_10, amount=count)
code_block_11 = CodeBlock(FuncValues=code_block_9, FuncValuesUnit=ofRepeatedItem)
# ---------- code_block_11.designscript (4 lines) ----------
{
"FuncValues": _FuncValues,
"FuncValuesUnit": _FuncValuesUnit
};
# ----------------------------------------

# group: Output Manager
output = CodeBlock(MainOutput=code_block_11) { MainOutput; RefOutput_geoColor; }  # unwired: RefOutput_geoColor
reference_output = CodeBlock(ref=geometry) { ref; }

# group: Input Manager
value_for_import_from_others_2 = CodeBlock(MainInput=code_block_7) { MainInput; RefInput1; RefInput2; }  # unwired: RefInput1, RefInput2

# group: <Func 2> Superstructure Structural Form Works
code_block_12 = CodeBlock { "TargetElements"; }
valueAtKey_2 = DesignScript.Builtin.Dictionary.ValueAtKey(dictionary=value_for_import_from_others_2.MainInput, key=code_block_12)
code_block_13 = CodeBlock { "Area"; }
# note: <Func>
getParameterValueByName = Element.GetParameterValueByName(element=valueAtKey_2, parameterName=code_block_13)
code_block_14 = CodeBlock(i=getParameterValueByName) { Math.Round(List.Flatten(i),2)*2; }
code_block_15 = CodeBlock { "M2"; }
count_2 = List.Count(list=code_block_14)
ofRepeatedItem_2 = List.OfRepeatedItem(item=code_block_15, amount=count_2)
code_block_16 = CodeBlock(FuncValues=code_block_14, FuncValuesUnit=ofRepeatedItem_2)  # same code as code_block_11

# group: Output Manager
output_2 = CodeBlock(MainOutput=code_block_16) { MainOutput; RefOutput_geoColor; }  # unwired: RefOutput_geoColor
reference_output_2 = CodeBlock { ref; }  # unwired: ref

# group: Input Manager
value_for_import_from_others_3 = CodeBlock(MainInput=code_block_7) { MainInput; RefInput1; RefInput2; }  # unwired: RefInput1, RefInput2

# group: <Func 3> Superstructure Structrual Rebar Work
code_block_17 = CodeBlock { "TargetElements"; }
# note: <Func>
valueAtKey_3 = DesignScript.Builtin.Dictionary.ValueAtKey(dictionary=value_for_import_from_others_3.MainInput, key=code_block_17)

code_block_18 = CodeBlock { "Volume"; }
# note: <Func>
getParameterValueByName_2 = Element.GetParameterValueByName(element=valueAtKey_3, parameterName=code_block_18)
rebar = DoubleInput(0)  # graph input
code_block_19 = CodeBlock(i=getParameterValueByName_2, 비율=rebar) { Math.Round(List.Flatten(i),2)*비율; }
code_block_20 = CodeBlock { "Ton"; }
count_3 = List.Count(list=code_block_19)
ofRepeatedItem_3 = List.OfRepeatedItem(item=code_block_20, amount=count_3)
code_block_21 = CodeBlock(FuncValues=code_block_19, FuncValuesUnit=ofRepeatedItem_3)  # same code as code_block_11

# group: Output Manager
output_3 = CodeBlock(MainOutput=code_block_21) { MainOutput; RefOutput_geoColor; }  # unwired: RefOutput_geoColor
reference_output_3 = CodeBlock { ref; }  # unwired: ref

# group: Output Manager
output_4 = CodeBlock { MainOutput; RefOutput_geoColor; }  # unwired: MainOutput, RefOutput_geoColor
reference_output_4 = CodeBlock { ref; }  # unwired: ref

# group: Output Manager
output_5 = CodeBlock { MainOutput; RefOutput_geoColor; }  # unwired: MainOutput, RefOutput_geoColor
reference_output_5 = CodeBlock { ref; }  # unwired: ref

# group: Output Manager
output_6 = CodeBlock { MainOutput; RefOutput_geoColor; }  # unwired: MainOutput, RefOutput_geoColor
reference_output_6 = CodeBlock { ref; }  # unwired: ref

# group: Output Manager
output_7 = CodeBlock { MainOutput; RefOutput_geoColor; }  # unwired: MainOutput, RefOutput_geoColor
reference_output_7 = CodeBlock { ref; }  # unwired: ref

# group: Output Manager
output_8 = CodeBlock { MainOutput; RefOutput_geoColor; }  # unwired: MainOutput, RefOutput_geoColor
reference_output_8 = CodeBlock { ref; }  # unwired: ref

# group: Output Manager
output_9 = CodeBlock { MainOutput; RefOutput_geoColor; }  # unwired: MainOutput, RefOutput_geoColor
reference_output_9 = CodeBlock { ref; }  # unwired: ref

code_block_22 = CodeBlock(i=select_target_family_element_and_2) { i; }

# group: Input Manager
value_for_import_from_others_4 = CodeBlock(MainInput=code_block_22) { MainInput; RefInput1; RefInput2; }  # unwired: RefInput1, RefInput2

# group: <Func 0> M2 Plastering Ext
code_block_23 = CodeBlock { "TargetElements"; }
# note: <Func>
valueAtKey_4 = DesignScript.Builtin.Dictionary.ValueAtKey(dictionary=value_for_import_from_others_4.MainInput, key=code_block_23)

code_block_24 = CodeBlock { "Area"; }
getParameterValueByName_3 = Element.GetParameterValueByName(element=valueAtKey_4, parameterName=code_block_24)
code_block_25 = CodeBlock(i=getParameterValueByName_3) { Math.Round(List.Flatten(i),2)*2; }
code_block_26 = CodeBlock { "M2"; }
count_4 = List.Count(list=code_block_25)
ofRepeatedItem_4 = List.OfRepeatedItem(item=code_block_26, amount=count_4)
code_block_27 = CodeBlock(FuncValues=code_block_25, FuncValuesUnit=ofRepeatedItem_4)  # same code as code_block_11

# group: Input Manager
value_for_import_from_others_5 = CodeBlock(MainInput=code_block_22) { MainInput; RefInput1; RefInput2; }  # unwired: RefInput1, RefInput2

# group: <Func 1> M2 Plastering Int
code_block_28 = CodeBlock { "TargetElements"; }
# note: <Func>
valueAtKey_5 = DesignScript.Builtin.Dictionary.ValueAtKey(dictionary=value_for_import_from_others_5.MainInput, key=code_block_28)

code_block_29 = CodeBlock { "Area"; }
getParameterValueByName_4 = Element.GetParameterValueByName(element=valueAtKey_5, parameterName=code_block_29)
code_block_30 = CodeBlock(i=getParameterValueByName_4) { Math.Round(List.Flatten(i),2)*2; }
code_block_31 = CodeBlock { "M2"; }
count_5 = List.Count(list=code_block_30)
ofRepeatedItem_5 = List.OfRepeatedItem(item=code_block_31, amount=count_5)
code_block_32 = CodeBlock(FuncValues=code_block_30, FuncValuesUnit=ofRepeatedItem_5)  # same code as code_block_11

# group: Input Manager
value_for_import_from_others_6 = CodeBlock(MainInput=code_block_22) { MainInput; RefInput1; RefInput2; }  # unwired: RefInput1, RefInput2

# group: <Func 2> M2 Int Wall Painting
code_block_33 = CodeBlock { "TargetElements"; }
# note: <Func>
valueAtKey_6 = DesignScript.Builtin.Dictionary.ValueAtKey(dictionary=value_for_import_from_others_6.MainInput, key=code_block_33)

code_block_34 = CodeBlock { "Area"; }
getParameterValueByName_5 = Element.GetParameterValueByName(element=valueAtKey_6, parameterName=code_block_34)
code_block_35 = CodeBlock(i=getParameterValueByName_5) { Math.Round(List.Flatten(i),2)*2; }
code_block_36 = CodeBlock { "M2"; }
count_6 = List.Count(list=code_block_35)
ofRepeatedItem_6 = List.OfRepeatedItem(item=code_block_36, amount=count_6)
code_block_37 = CodeBlock(FuncValues=code_block_35, FuncValuesUnit=ofRepeatedItem_6)  # same code as code_block_11

# group: Input Manager
value_for_import_from_others_7 = CodeBlock(MainInput=code_block_22) { MainInput; RefInput1; RefInput2; }  # unwired: RefInput1, RefInput2

# group: <Func 4> M2 Insulation
code_block_38 = CodeBlock { "TargetElements"; }
# note: <Func>
valueAtKey_7 = DesignScript.Builtin.Dictionary.ValueAtKey(dictionary=value_for_import_from_others_7.MainInput, key=code_block_38)

code_block_39 = CodeBlock { "Area"; }
getParameterValueByName_6 = Element.GetParameterValueByName(element=valueAtKey_7, parameterName=code_block_39)
code_block_40 = CodeBlock(i=getParameterValueByName_6) { Math.Round(List.Flatten(i),2)*2; }
code_block_41 = CodeBlock { "M2"; }
count_7 = List.Count(list=code_block_40)
ofRepeatedItem_7 = List.OfRepeatedItem(item=code_block_41, amount=count_7)
code_block_42 = CodeBlock(FuncValues=code_block_40, FuncValuesUnit=ofRepeatedItem_7)  # same code as code_block_11

# group: Input Manager
value_for_import_from_others_8 = CodeBlock(MainInput=code_block_22) { MainInput; RefInput1; RefInput2; }  # unwired: RefInput1, RefInput2

# group: <Func 5> M2 Block
code_block_43 = CodeBlock { "TargetElements"; }
# note: <Func>
valueAtKey_8 = DesignScript.Builtin.Dictionary.ValueAtKey(dictionary=value_for_import_from_others_8.MainInput, key=code_block_43)

code_block_44 = CodeBlock { "Area"; }
getParameterValueByName_7 = Element.GetParameterValueByName(element=valueAtKey_8, parameterName=code_block_44)
code_block_45 = CodeBlock(i=getParameterValueByName_7) { Math.Round(List.Flatten(i),2)*2; }
code_block_46 = CodeBlock { "M2"; }
count_8 = List.Count(list=code_block_45)
ofRepeatedItem_8 = List.OfRepeatedItem(item=code_block_46, amount=count_8)
code_block_47 = CodeBlock(FuncValues=code_block_45, FuncValuesUnit=ofRepeatedItem_8)  # same code as code_block_11

# group: Input Manager
value_for_import_from_others_9 = CodeBlock(MainInput=code_block_22) { MainInput; RefInput1; RefInput2; }  # unwired: RefInput1, RefInput2

# group: <Func 3> M2 Ext Wall Painting
code_block_48 = CodeBlock { "TargetElements"; }
# note: <Func>
valueAtKey_9 = DesignScript.Builtin.Dictionary.ValueAtKey(dictionary=value_for_import_from_others_9.MainInput, key=code_block_48)

code_block_49 = CodeBlock { "Area"; }
getParameterValueByName_8 = Element.GetParameterValueByName(element=valueAtKey_9, parameterName=code_block_49)
code_block_50 = CodeBlock(i=getParameterValueByName_8) { Math.Round(List.Flatten(i),2)*2; }
code_block_51 = CodeBlock { "M2"; }
count_9 = List.Count(list=code_block_50)
ofRepeatedItem_9 = List.OfRepeatedItem(item=code_block_51, amount=count_9)
code_block_52 = CodeBlock(FuncValues=code_block_50, FuncValuesUnit=ofRepeatedItem_9)  # same code as code_block_11
code_block_53 = CodeBlock(i=select_target_family_element_and_3) { i; }

# group: Input Manager
value_for_import_from_others_10 = CodeBlock(MainInput=code_block_53) { MainInput; RefInput1; RefInput2; }  # unwired: RefInput1, RefInput2

# group: <Func 5> M2 Block
code_block_54 = CodeBlock { "TargetElements"; }
# note: <Func>
valueAtKey_10 = DesignScript.Builtin.Dictionary.ValueAtKey(dictionary=value_for_import_from_others_10.MainInput, key=code_block_54)

code_block_55 = CodeBlock { "Area"; }
getParameterValueByName_9 = Element.GetParameterValueByName(element=valueAtKey_10, parameterName=code_block_55)
code_block_56 = CodeBlock(i=getParameterValueByName_9) { Math.Round(List.Flatten(i),2)*2; }
code_block_57 = CodeBlock { "M2"; }
count_10 = List.Count(list=code_block_56)
ofRepeatedItem_10 = List.OfRepeatedItem(item=code_block_57, amount=count_10)
code_block_58 = CodeBlock(FuncValues=code_block_56, FuncValuesUnit=ofRepeatedItem_10)  # same code as code_block_11

# group: Output Manager
output_10 = CodeBlock(MainOutput=code_block_58) { MainOutput; RefOutput_geoColor; }  # unwired: RefOutput_geoColor
reference_output_10 = CodeBlock { ref; }  # unwired: ref

# group: Input Manager
value_for_import_from_others_11 = CodeBlock(MainInput=code_block_53) { MainInput; RefInput1; RefInput2; }  # unwired: RefInput1, RefInput2

# group: <Func 4> M2 Insulation
code_block_59 = CodeBlock { "TargetElements"; }
# note: <Func>
valueAtKey_11 = DesignScript.Builtin.Dictionary.ValueAtKey(dictionary=value_for_import_from_others_11.MainInput, key=code_block_59)

code_block_60 = CodeBlock { "Area"; }
getParameterValueByName_10 = Element.GetParameterValueByName(element=valueAtKey_11, parameterName=code_block_60)
code_block_61 = CodeBlock(i=getParameterValueByName_10) { Math.Round(List.Flatten(i),2)*2; }
code_block_62 = CodeBlock { "M2"; }
count_11 = List.Count(list=code_block_61)
ofRepeatedItem_11 = List.OfRepeatedItem(item=code_block_62, amount=count_11)
code_block_63 = CodeBlock(FuncValues=code_block_61, FuncValuesUnit=ofRepeatedItem_11)  # same code as code_block_11

# group: Input Manager
value_for_import_from_others_12 = CodeBlock(MainInput=code_block_53) { MainInput; RefInput1; RefInput2; }  # unwired: RefInput1, RefInput2

# group: <Func 3> M2 Ext Wall Painting
code_block_64 = CodeBlock { "TargetElements"; }
# note: <Func>
valueAtKey_12 = DesignScript.Builtin.Dictionary.ValueAtKey(dictionary=value_for_import_from_others_12.MainInput, key=code_block_64)

code_block_65 = CodeBlock { "Area"; }
getParameterValueByName_11 = Element.GetParameterValueByName(element=valueAtKey_12, parameterName=code_block_65)
code_block_66 = CodeBlock(i=getParameterValueByName_11) { Math.Round(List.Flatten(i),2)*2; }
code_block_67 = CodeBlock { "M2"; }
count_12 = List.Count(list=code_block_66)
ofRepeatedItem_12 = List.OfRepeatedItem(item=code_block_67, amount=count_12)
code_block_68 = CodeBlock(FuncValues=code_block_66, FuncValuesUnit=ofRepeatedItem_12)  # same code as code_block_11

# group: Input Manager
value_for_import_from_others_13 = CodeBlock(MainInput=code_block_53) { MainInput; RefInput1; RefInput2; }  # unwired: RefInput1, RefInput2

# group: <Func 1> M2 Plastering Int
code_block_69 = CodeBlock { "TargetElements"; }
# note: <Func>
valueAtKey_13 = DesignScript.Builtin.Dictionary.ValueAtKey(dictionary=value_for_import_from_others_13.MainInput, key=code_block_69)

code_block_70 = CodeBlock { "Area"; }
getParameterValueByName_12 = Element.GetParameterValueByName(element=valueAtKey_13, parameterName=code_block_70)
code_block_71 = CodeBlock(i=getParameterValueByName_12) { Math.Round(List.Flatten(i),2)*2; }
code_block_72 = CodeBlock { "M2"; }
count_13 = List.Count(list=code_block_71)
ofRepeatedItem_13 = List.OfRepeatedItem(item=code_block_72, amount=count_13)
code_block_73 = CodeBlock(FuncValues=code_block_71, FuncValuesUnit=ofRepeatedItem_13)  # same code as code_block_11

# group: Output Manager
output_11 = CodeBlock(MainOutput=code_block_73) { MainOutput; RefOutput_geoColor; }  # unwired: RefOutput_geoColor
reference_output_11 = CodeBlock { ref; }  # unwired: ref

# group: Input Manager
value_for_import_from_others_14 = CodeBlock(MainInput=code_block_53) { MainInput; RefInput1; RefInput2; }  # unwired: RefInput1, RefInput2

# group: <Func 2> M2 Int Wall Painting
code_block_74 = CodeBlock { "TargetElements"; }
# note: <Func>
valueAtKey_14 = DesignScript.Builtin.Dictionary.ValueAtKey(dictionary=value_for_import_from_others_14.MainInput, key=code_block_74)

code_block_75 = CodeBlock { "Area"; }
getParameterValueByName_13 = Element.GetParameterValueByName(element=valueAtKey_14, parameterName=code_block_75)
code_block_76 = CodeBlock(i=getParameterValueByName_13) { Math.Round(List.Flatten(i),2)*2; }
code_block_77 = CodeBlock { "M2"; }
count_14 = List.Count(list=code_block_76)
ofRepeatedItem_14 = List.OfRepeatedItem(item=code_block_77, amount=count_14)
code_block_78 = CodeBlock(FuncValues=code_block_76, FuncValuesUnit=ofRepeatedItem_14)  # same code as code_block_11

# group: Output Manager
output_12 = CodeBlock(MainOutput=code_block_78) { MainOutput; RefOutput_geoColor; }  # unwired: RefOutput_geoColor
reference_output_12 = CodeBlock { ref; }  # unwired: ref

# group: Input Manager
value_for_import_from_others_15 = CodeBlock(MainInput=code_block_53) { MainInput; RefInput1; RefInput2; }  # unwired: RefInput1, RefInput2

# group: <Func 0> M2 Plastering Ext
code_block_79 = CodeBlock { "TargetElements"; }
# note: <Func>
valueAtKey_15 = DesignScript.Builtin.Dictionary.ValueAtKey(dictionary=value_for_import_from_others_15.MainInput, key=code_block_79)

code_block_80 = CodeBlock { "Area"; }
getParameterValueByName_14 = Element.GetParameterValueByName(element=valueAtKey_15, parameterName=code_block_80)
code_block_81 = CodeBlock(i=getParameterValueByName_14) { Math.Round(List.Flatten(i),2)*2; }
code_block_82 = CodeBlock { "M2"; }
count_15 = List.Count(list=code_block_81)
ofRepeatedItem_15 = List.OfRepeatedItem(item=code_block_82, amount=count_15)
code_block_83 = CodeBlock(FuncValues=code_block_81, FuncValuesUnit=ofRepeatedItem_15)  # same code as code_block_11

# group: Output Manager
reference_output_13 = CodeBlock { ref; }  # unwired: ref

# group: Output Manager
reference_output_14 = CodeBlock { ref; }  # unwired: ref

# group: Output Manager
reference_output_15 = CodeBlock { ref; }  # unwired: ref

code_block_84 = CodeBlock(i=select_target_family_element_and_4) { i; }

# group: Input Manager
value_for_import_from_others_16 = CodeBlock(MainInput=code_block_84) { MainInput; RefInput1; RefInput2; }  # unwired: RefInput1, RefInput2

# group: <Func 5> M2 Block
code_block_85 = CodeBlock { "TargetElements"; }
# note: <Func>
valueAtKey_16 = DesignScript.Builtin.Dictionary.ValueAtKey(dictionary=value_for_import_from_others_16.MainInput, key=code_block_85)

code_block_86 = CodeBlock { "Area"; }
getParameterValueByName_15 = Element.GetParameterValueByName(element=valueAtKey_16, parameterName=code_block_86)
code_block_87 = CodeBlock(i=getParameterValueByName_15) { Math.Round(List.Flatten(i),2)*2; }
code_block_88 = CodeBlock { "M2"; }
count_16 = List.Count(list=code_block_87)
ofRepeatedItem_16 = List.OfRepeatedItem(item=code_block_88, amount=count_16)
code_block_89 = CodeBlock(FuncValues=code_block_87, FuncValuesUnit=ofRepeatedItem_16)  # same code as code_block_11

# group: Output Manager
output_13 = CodeBlock(MainOutput=code_block_89) { MainOutput; RefOutput_geoColor; }  # unwired: RefOutput_geoColor
reference_output_16 = CodeBlock { ref; }  # unwired: ref

# group: Input Manager
value_for_import_from_others_17 = CodeBlock(MainInput=code_block_84) { MainInput; RefInput1; RefInput2; }  # unwired: RefInput1, RefInput2

# group: <Func 1> M2 Plastering Int
code_block_90 = CodeBlock { "TargetElements"; }
# note: <Func>
valueAtKey_17 = DesignScript.Builtin.Dictionary.ValueAtKey(dictionary=value_for_import_from_others_17.MainInput, key=code_block_90)

code_block_91 = CodeBlock { "Area"; }
getParameterValueByName_16 = Element.GetParameterValueByName(element=valueAtKey_17, parameterName=code_block_91)
code_block_92 = CodeBlock(i=getParameterValueByName_16) { Math.Round(List.Flatten(i),2)*2; }
code_block_93 = CodeBlock { "M2"; }
count_17 = List.Count(list=code_block_92)
ofRepeatedItem_17 = List.OfRepeatedItem(item=code_block_93, amount=count_17)
code_block_94 = CodeBlock(FuncValues=code_block_92, FuncValuesUnit=ofRepeatedItem_17)  # same code as code_block_11

# group: Output Manager
output_14 = CodeBlock(MainOutput=code_block_94) { MainOutput; RefOutput_geoColor; }  # unwired: RefOutput_geoColor
reference_output_17 = CodeBlock { ref; }  # unwired: ref

# group: Input Manager
value_for_import_from_others_18 = CodeBlock(MainInput=code_block_84) { MainInput; RefInput1; RefInput2; }  # unwired: RefInput1, RefInput2

# group: <Func 2> M2 Int Wall Painting
code_block_95 = CodeBlock { "TargetElements"; }
# note: <Func>
valueAtKey_18 = DesignScript.Builtin.Dictionary.ValueAtKey(dictionary=value_for_import_from_others_18.MainInput, key=code_block_95)

code_block_96 = CodeBlock { "Area"; }
getParameterValueByName_17 = Element.GetParameterValueByName(element=valueAtKey_18, parameterName=code_block_96)
code_block_97 = CodeBlock(i=getParameterValueByName_17) { Math.Round(List.Flatten(i),2)*2; }
code_block_98 = CodeBlock { "M2"; }
count_18 = List.Count(list=code_block_97)
ofRepeatedItem_18 = List.OfRepeatedItem(item=code_block_98, amount=count_18)
code_block_99 = CodeBlock(FuncValues=code_block_97, FuncValuesUnit=ofRepeatedItem_18)  # same code as code_block_11

# group: Output Manager
output_15 = CodeBlock(MainOutput=code_block_99) { MainOutput; RefOutput_geoColor; }  # unwired: RefOutput_geoColor
reference_output_18 = CodeBlock { ref; }  # unwired: ref

# group: Input Manager
value_for_import_from_others_19 = CodeBlock(MainInput=code_block_84) { MainInput; RefInput1; RefInput2; }  # unwired: RefInput1, RefInput2

# group: <Func 0> M2 Plastering Ext
code_block_100 = CodeBlock { "TargetElements"; }
# note: <Func>
valueAtKey_19 = DesignScript.Builtin.Dictionary.ValueAtKey(dictionary=value_for_import_from_others_19.MainInput, key=code_block_100)

code_block_101 = CodeBlock { "Area"; }
getParameterValueByName_18 = Element.GetParameterValueByName(element=valueAtKey_19, parameterName=code_block_101)
code_block_102 = CodeBlock(i=getParameterValueByName_18) { Math.Round(List.Flatten(i),2)*2; }
code_block_103 = CodeBlock { "M2"; }
count_19 = List.Count(list=code_block_102)
ofRepeatedItem_19 = List.OfRepeatedItem(item=code_block_103, amount=count_19)
code_block_104 = CodeBlock(FuncValues=code_block_102, FuncValuesUnit=ofRepeatedItem_19)  # same code as code_block_11

# group: Output Manager
reference_output_19 = CodeBlock { ref; }  # unwired: ref

# group: Input Manager
value_for_import_from_others_20 = CodeBlock(MainInput=code_block_84) { MainInput; RefInput1; RefInput2; }  # unwired: RefInput1, RefInput2

# group: <Func 4> M2 Wall Tile
code_block_105 = CodeBlock { "TargetElements"; }
# note: <Func>
valueAtKey_20 = DesignScript.Builtin.Dictionary.ValueAtKey(dictionary=value_for_import_from_others_20.MainInput, key=code_block_105)

code_block_106 = CodeBlock { "Area"; }
getParameterValueByName_19 = Element.GetParameterValueByName(element=valueAtKey_20, parameterName=code_block_106)
code_block_107 = CodeBlock(i=getParameterValueByName_19) { Math.Round(List.Flatten(i),2)*2; }
code_block_108 = CodeBlock { "M2"; }
count_20 = List.Count(list=code_block_107)
ofRepeatedItem_20 = List.OfRepeatedItem(item=code_block_108, amount=count_20)
code_block_109 = CodeBlock(FuncValues=code_block_107, FuncValuesUnit=ofRepeatedItem_20)  # same code as code_block_11

# group: Output Manager
reference_output_20 = CodeBlock { ref; }  # unwired: ref
output_16 = CodeBlock(MainOutput=code_block_109) { MainOutput; RefOutput_geoColor; }  # unwired: RefOutput_geoColor

# group: Input Manager
value_for_import_from_others_21 = CodeBlock(MainInput=code_block_84) { MainInput; RefInput1; RefInput2; }  # unwired: RefInput1, RefInput2

# group: <Func 3> M2 Liquid waterproofing
code_block_110 = CodeBlock { "TargetElements"; }
# note: <Func>
valueAtKey_21 = DesignScript.Builtin.Dictionary.ValueAtKey(dictionary=value_for_import_from_others_21.MainInput, key=code_block_110)

code_block_111 = CodeBlock { "Length"; }
getParameterValueByName_20 = Element.GetParameterValueByName(element=valueAtKey_21, parameterName=code_block_111)
height_for_liquid_waterproofing = DoubleInput(1)  # graph input
code_block_112 = CodeBlock(length=getParameterValueByName_20, H=height_for_liquid_waterproofing) { length/1000*H; }
code_block_113 = CodeBlock { "M2"; }
count_21 = List.Count(list=code_block_112)
ofRepeatedItem_21 = List.OfRepeatedItem(item=code_block_113, amount=count_21)
code_block_114 = CodeBlock(FuncValues=code_block_112, FuncValuesUnit=ofRepeatedItem_21)  # same code as code_block_11

# group: Output Manager
reference_output_21 = CodeBlock { ref; }  # unwired: ref
output_17 = CodeBlock(MainOutput=code_block_114) { MainOutput; RefOutput_geoColor; }  # unwired: RefOutput_geoColor

code_block_115 = CodeBlock(i=select_target_family_element_and_5) { i; }

# group: Input Manager
value_for_import_from_others_22 = CodeBlock(MainInput=code_block_115) { MainInput; RefInput1; RefInput2; }  # unwired: RefInput1, RefInput2

# group: <Func 0> M Skirt Paint
code_block_116 = CodeBlock { "TargetElements"; }
# note: <Func>
valueAtKey_22 = DesignScript.Builtin.Dictionary.ValueAtKey(dictionary=value_for_import_from_others_22.MainInput, key=code_block_116)

code_block_117 = CodeBlock { "Length"; }
getParameterValueByName_21 = Element.GetParameterValueByName(element=valueAtKey_22, parameterName=code_block_117)
code_block_118 = CodeBlock(length=getParameterValueByName_21) { length/1000; }
code_block_119 = CodeBlock { "M"; }
count_22 = List.Count(list=code_block_118)
ofRepeatedItem_22 = List.OfRepeatedItem(item=code_block_119, amount=count_22)
code_block_120 = CodeBlock(FuncValues=code_block_118, FuncValuesUnit=ofRepeatedItem_22)  # same code as code_block_11

# group: Output Manager
output_18 = CodeBlock(MainOutput=code_block_120) { MainOutput; RefOutput_geoColor; }  # unwired: RefOutput_geoColor
reference_output_22 = CodeBlock { ref; }  # unwired: ref
