# Dynamo graph 19 Slab Edge (1220).dyn (Dynamo 2.12.0.5650)

# group: Sample
code_block = CodeBlock {  }
code_block_2 = CodeBlock {  }

# group: Primary Input
categories = Categories("OST_StructuralFoundation")
all_elements_of_category = ElementsOfCategory(Category=categories)
file_path = Filename("..\BIM_물량집계 자동화 산출기준표_rC(20211029).xlsx")
file_from_path = FileObject(path=file_path)
code_block_3 = CodeBlock { "Str Foundations"; }

# group: GetFull WMCodeDescription PerElement
code_block_4 = CodeBlock(InputElement=all_elements_of_category, InputFilePath=file_from_path, InputSheetName=code_block_3) { _InputElement; _InputFilePath; _InputSheetName; }
excelDataManagerNode = Python(IN[0]=code_block_4._InputElement, IN[1]=code_block_4._InputFilePath, IN[2]=code_block_4._InputSheetName)  # CPython3
# ---------- excelDataManagerNode.python (279 lines) ----------
# Load the Python Standard and DesignScript Libraries
import os
import sys
sys.path.append(os.getenv('LOCALAPPDATA').replace('\\','\\\\') + r'\Programs\Python\Python39\Lib\site-packages')
import clr
clr.AddReference('RevitAPI')
import Autodesk

clr.AddReference('ProtoGeometry')
from Autodesk.DesignScript.Geometry import *

clr.AddReference('RevitNodes')
import Revit
clr.ImportExtensions(Revit.Elements)

clr.ImportExtensions(Revit.GeometryConversion)
clr.ImportExtensions(Revit.GeometryReferences)

clr.AddReference('RevitServices')
import RevitServices
from RevitServices.Persistence import DocumentManager
from RevitServices.Transactions import TransactionManager

doc = DocumentManager.Instance.CurrentDBDocument

import random
import itertools
from functools import reduce
from collections import Iterable
import datetime
import openpyxl

def iterable(obj):
    return isinstance(obj, Iterable)

def findUnique(inputs):
    result = []
    for i in inputs:
        if i in result:
            pass
        else:
            result.append(i)
    return result

# The inputs to this node will be stored as a list in the IN variables.
dataEnteringNode = IN
inputElements = IN[0]
inputFilePath = IN[1]
inputSheetName = IN[2]

def importExcel(path, SheetNameIn):
    wb_obj = openpyxl.load_workbook(str(path), data_only=True)
    sheet_obj = wb_obj.get_sheet_by_name(str(SheetNameIn))

    m_row = sheet_obj.max_row
    m_col = sheet_obj.max_column

    listOut = []

    for i in range(1, m_row +1):
        listTemp = []
        for j in range(1, m_col + 1):
            cell_obj = sheet_obj.cell(row=i, column=j)
            listTemp.append(cell_obj.value)
            if len(listTemp) == m_col:
                listOut.append(listTemp)
    return listOut

def getUsedFamilyTypeOfModeling(elements):
    familyCode = list(map(lambda x: x.Name.split('_')[0], elements))
    unq_familyCode = findUnique(familyCode)
    return unq_familyCode
    
def createExcelDataDictionary(values):
    result = {}
    for i in range(len(values)):
        result[str(i)] = values[i]
    return result

def findTargetIndex(targets, list):
    result = []
    for target in targets:
        for i in range(len(list)):
            if target in str(list[i]):
                result.append(i)
            else:
                pass
    result.sort()
    return result
    
def GetValueAtKeys(keys, dictionary):
    result = [] 
    for i in keys:
        result.append(dictionary[str(i)])
    return result


# Place your code below this line
usedFamilyTypeOfModeling = getUsedFamilyTypeOfModeling(inputElements)
excelWholeDataSet = importExcel(inputFilePath, inputSheetName)
trExcelWholeDataSet = list(zip(*excelWholeDataSet))
excelColumnDataSet = createExcelDataDictionary(trExcelWholeDataSet)
excelRowDataSet = createExcelDataDictionary(excelWholeDataSet)
ColumnIndexOfUsedFamilyType = findTargetIndex(usedFamilyTypeOfModeling, trExcelWholeDataSet)
ColDataSetOfUsedFamilyType = GetValueAtKeys(ColumnIndexOfUsedFamilyType, excelColumnDataSet)
materialPerElementFromModeling = []
for i in inputElements:
    materialPerElementFromModeling.append(i.GetMaterials())
#list(map(lambda x: x.GetMaterials, inputElements)) "맵함수로 처리하면 리스트화 할 때 타입 변환 오류 남"

targetWMRowIndex = []
for i in ColDataSetOfUsedFamilyType:
    targetWMRowIndex.append(findTargetIndex(['000'], i))

rowDataSetOfUsedWM = []
for i in targetWMRowIndex:
    rowDataSetOfUsedWM.append(GetValueAtKeys(i, excelRowDataSet))

workGroup = []
for i in rowDataSetOfUsedWM:
    tmp = []
    for j in i:
        tmp.append(j[0])
    workGroup.append(tmp)
    
workMaster = []
for i in range(len(ColDataSetOfUsedFamilyType)):
    tmp=[]
    for k in targetWMRowIndex[i]:
        tmp.append(ColDataSetOfUsedFamilyType[i][k])
    workMaster.append(tmp)

matchedWM = []
for i in range(len(workGroup)):
    tmp = []
    for j in range(len(workGroup[i])):
        fullWM = workGroup[i][j] +"-"+ workMaster[i][j]
        tmp.append(fullWM)
    matchedWM.append(tmp)

matchedWorkGruopAndMasterCode = []
for i in matchedWM:
    if len(i) > 0:
        matchedWorkGruopAndMasterCode.append(i)
    else:
        pass

matchedWMDescription = []
for i in rowDataSetOfUsedWM:
    tmp=[]
    for j in i:
        tmp.append(j[1] +" "+ j[2] +" "+ j[3] +" "+ "("+ j[4] +")")
    if len(tmp) > 0:
        matchedWMDescription.append(tmp)
    else:
        pass

matchedWMUnit = []
for i in rowDataSetOfUsedWM:
    tmp=[]
    for j in i:
        tmp.append(j[4])
    if len(tmp) > 0:
        matchedWMUnit.append(tmp)
    else:
        pass

matchedWorkGruopAndMasterCode_flat = list(itertools.chain(*matchedWorkGruopAndMasterCode))
matchedWMDescription_flat = list(itertools.chain(*matchedWMDescription))

dic_WMandDescription_Excel = {}
for i in range(len(matchedWorkGruopAndMasterCode_flat)):
    dic_WMandDescription_Excel[matchedWorkGruopAndMasterCode_flat[i]] = matchedWMDescription_flat[i]

usedFamilyTypeInExcelOrder = list(map(lambda x: x[3], ColDataSetOfUsedFamilyType))
usedFamilyCodeInExcelOrder = findUnique(list(map(lambda x: x.split('_')[0], usedFamilyTypeInExcelOrder)))

dic_FamilyCodeandWM = {}
for i in range(len(usedFamilyCodeInExcelOrder)):
    dic_FamilyCodeandWM[usedFamilyCodeInExcelOrder[i]] = matchedWorkGruopAndMasterCode[i]

workMasterCodePerElement = []
familyCodePerElem = list(map(lambda x: x.Name.split('_')[0], inputElements))
for i in familyCodePerElem:
    workMasterCodePerElement.append(dic_FamilyCodeandWM[i])

materialNamePerElem = []
for i in materialPerElementFromModeling:
    tmp = []
    for j in i:
        tmp.append(j.Name)
    materialNamePerElem.append(tmp)

WMPerElementFromModeling = []
for i in materialNamePerElem:
    tmp = []
    for j in i:
        tmp.append(j.split('_')[0])
    WMPerElementFromModeling.append(tmp)

specPerElementFromModeling = []
for i in materialNamePerElem:
    tmp = []
    for j in i:
        a = j.split('_')
        del a[0]
        b = " ".join(a)
        tmp.append(b)
    specPerElementFromModeling.append(tmp)

WMPerElementFromModeling_flat = list(itertools.chain(*WMPerElementFromModeling))
specPerElementFromModeling_flat = list(itertools.chain(*specPerElementFromModeling))

dic_WMandDescription_Model = {}
for i in range(len(WMPerElementFromModeling_flat)):
    dic_WMandDescription_Model[WMPerElementFromModeling_flat[i]] = specPerElementFromModeling_flat[i]

def findAllKeys(dict):
    result = []
    for key in dict.keys():
        result.append(key)
    return result

def findAllValues(dict):
    result = []
    for key in dict.keys():
        result.append(dict[key])
    return result

keys_WMandDescription_Model = findAllKeys(dic_WMandDescription_Model)
keys_WMandDescription_Excel = findAllKeys(dic_WMandDescription_Excel)

keys_WMandDescription_Both = list(set(keys_WMandDescription_Model + keys_WMandDescription_Excel))
values_WMandDescription_Both = []
for i in keys_WMandDescription_Both:
    if i in keys_WMandDescription_Model:
        values_WMandDescription_Both.append(dic_WMandDescription_Model[i])
    else:
        values_WMandDescription_Both.append(dic_WMandDescription_Excel[i])

dic_WMandDescription_Both = {}
for i in range(len(keys_WMandDescription_Both)):
    dic_WMandDescription_Both[keys_WMandDescription_Both[i]] = values_WMandDescription_Both[i]

workMasterCodePerElementFromBoth = []
for i in range(len(workMasterCodePerElement)):
    #tmp = []
    a = WMPerElementFromModeling[i] + workMasterCodePerElement[i]
    b = findUnique(a)
    workMasterCodePerElementFromBoth.append(b)

specPerElement = []
for i in workMasterCodePerElementFromBoth:
    tmp = []
    for j in i:
        tmp.append(dic_WMandDescription_Both[j])
    specPerElement.append(tmp)

fullWMCodeDescriptionPerElement = []
for i in range(len(workMasterCodePerElementFromBoth)):
    tmp = []
    for j in range(len(workMasterCodePerElementFromBoth[i])):
        a = workMasterCodePerElementFromBoth[i][j] +": "+ specPerElement[i][j]
        tmp.append(a)
    fullWMCodeDescriptionPerElement.append(tmp)

fullWMinfo = {
"AllElement": inputElements,
"WorkMasterCodePerFamilyType": dic_FamilyCodeandWM,
"WorkMasterCodePerElementBoth": workMasterCodePerElementFromBoth,
"FullWMCodeDescriptionPerElement": fullWMCodeDescriptionPerElement
}



result = fullWMinfo

# Assign your output to the OUT variable.
OUT = result
# ----------------------------------------

# group: Organize AllElementInform AsDictionary
set_up_all_element_inform_as = Python(IN[0]=excelDataManagerNode)  # "Set Up All Element Inform as Dictionary"; CPython3
# ---------- set_up_all_element_inform_as.python (119 lines) ----------
# Load the Python Standard and DesignScript Libraries
import os
import sys
sys.path.append(os.getenv('LOCALAPPDATA').replace('\\','\\\\') + r'\Programs\Python\Python39\Lib\site-packages')
import clr
clr.AddReference('RevitAPI')
import Autodesk

clr.AddReference('ProtoGeometry')
from Autodesk.DesignScript.Geometry import *

clr.AddReference('RevitNodes')
import Revit
clr.ImportExtensions(Revit.Elements)

clr.ImportExtensions(Revit.GeometryConversion)
clr.ImportExtensions(Revit.GeometryReferences)

clr.AddReference('RevitServices')
import RevitServices
from RevitServices.Persistence import DocumentManager
from RevitServices.Transactions import TransactionManager

doc = DocumentManager.Instance.CurrentDBDocument

import random
import itertools
from functools import reduce
from collections import Iterable
import datetime
import openpyxl

def iterable(obj):
    return isinstance(obj, Iterable)

def findUnique(inputs):
    result = []
    for i in inputs:
        if i in result:
            pass
        else:
            result.append(i)
    return result

# The inputs to this node will be stored as a list in the IN variables.
dataEnteringNode = IN
inputDict = IN[0]


def importExcel(path, SheetNameIn):
    wb_obj = openpyxl.load_workbook(str(path), data_only=True)
    sheet_obj = wb_obj.get_sheet_by_name(str(SheetNameIn))

    m_row = sheet_obj.max_row
    m_col = sheet_obj.max_column

    listOut = []

    for i in range(1, m_row +1):
        listTemp = []
        for j in range(1, m_col + 1):
            cell_obj = sheet_obj.cell(row=i, column=j)
            listTemp.append(cell_obj.value)
            if len(listTemp) == m_col:
                listOut.append(listTemp)
    return listOut

def getUsedFamilyTypeOfModeling(elements):
    familyCode = list(map(lambda x: x.Name.split('_')[0], elements))
    unq_familyCode = findUnique(familyCode)
    return unq_familyCode
    
def createExcelDataDictionary(values):
    result = {}
    for i in range(len(values)):
        result[str(i)] = values[i]
    return result

def findTargetIndex(targets, list):
    result = []
    for target in targets:
        for i in range(len(list)):
            if target in str(list[i]):
                result.append(i)
            else:
                pass
    result.sort()
    return result
    
def GetValueAtKeys(keys, dictionary):
    result = [] 
    for i in keys:
        result.append(dictionary[str(i)])
    return result


# Place your code below this line
element = inputDict["AllElement"]
elementType = []
for i in element:
    elementType.append(i.Name)
familyCode = []
for i in elementType:
    familyCode.append(i.split("_")[0])
fullWMCodeDescriptionPerElement = inputDict["FullWMCodeDescriptionPerElement"]

resultDict = {
"Element": element,
"ElementType": elementType,
"FamilyCode": familyCode,
"FullWMCodeDescriptionPerElement": fullWMCodeDescriptionPerElement
}



result = resultDict

# Assign your output to the OUT variable.
OUT = result
# ----------------------------------------

# group: Select Target Family Element And Connected WorkMasters
code_block_5 = CodeBlock { 1; }
select_target_family_element_and = Python(IN[0]=set_up_all_element_inform_as, IN[1]=code_block_5)  # "Select Target Family Element And Connected WorkMasters"; CPython3
# ---------- select_target_family_element_and.python (138 lines) ----------
# Load the Python Standard and DesignScript Libraries
import os
import sys
sys.path.append(os.getenv('LOCALAPPDATA').replace('\\','\\\\') + r'\Programs\Python\Python39\Lib\site-packages')
import clr
clr.AddReference('RevitAPI')
import Autodesk

clr.AddReference('ProtoGeometry')
from Autodesk.DesignScript.Geometry import *

clr.AddReference('RevitNodes')
import Revit
clr.ImportExtensions(Revit.Elements)

clr.ImportExtensions(Revit.GeometryConversion)
clr.ImportExtensions(Revit.GeometryReferences)

clr.AddReference('RevitServices')
import RevitServices
from RevitServices.Persistence import DocumentManager
from RevitServices.Transactions import TransactionManager

doc = DocumentManager.Instance.CurrentDBDocument

import random
import itertools
from functools import reduce
from collections import Iterable
import datetime
import openpyxl

def iterable(obj):
    return isinstance(obj, Iterable)

def findUnique(inputs):
    result = []
    for i in inputs:
        if i in result:
            pass
        else:
            result.append(i)
    return result

# The inputs to this node will be stored as a list in the IN variables.
dataEnteringNode = IN
inputDict = IN[0]
inputIndex = IN[1]


def importExcel(path, SheetNameIn):
    wb_obj = openpyxl.load_workbook(str(path), data_only=True)
    sheet_obj = wb_obj.get_sheet_by_name(str(SheetNameIn))

    m_row = sheet_obj.max_row
    m_col = sheet_obj.max_column

    listOut = []

    for i in range(1, m_row +1):
        listTemp = []
        for j in range(1, m_col + 1):
            cell_obj = sheet_obj.cell(row=i, column=j)
            listTemp.append(cell_obj.value)
            if len(listTemp) == m_col:
                listOut.append(listTemp)
    return listOut

def getUsedFamilyTypeOfModeling(elements):
    familyCode = list(map(lambda x: x.Name.split('_')[0], elements))
    unq_familyCode = findUnique(familyCode)
    return unq_familyCode
    
def createExcelDataDictionary(values):
    result = {}
    for i in range(len(values)):
        result[str(i)] = values[i]
    return result

def findTargetIndex(targets, list):
    result = []
    for target in targets:
        for i in range(len(list)):
            if target in str(list[i]):
                result.append(i)
            else:
                pass
    result.sort()
    return result
    
def GetValueAtKeys(keys, dictionary):
    result = [] 
    for i in keys:
        result.append(dictionary[str(i)])
    return result


# Place your code below this line
fullWMCodeDescriptionPerElement = inputDict["FullWMCodeDescriptionPerElement"]
element = inputDict["Element"]
familyCode = inputDict["FamilyCode"]
familyCode_unique = findUnique(familyCode)
targetFamilyCode = familyCode_unique[inputIndex]
targetIndex = []
for i in range(len(familyCode)):
    if targetFamilyCode in familyCode[i]:
        targetIndex.append(i)
    else:
        pass

targetElements = []
for i in targetIndex:
    targetElements.append(element[i])

targetFamilyCode = []
for i in targetIndex:
    targetFamilyCode.append(element[i].Name)

WMforTargetElements = []
for i in targetIndex:
    WMforTargetElements.append(fullWMCodeDescriptionPerElement[i])

WMforTargetElements_flat = list(itertools.chain(*WMforTargetElements))
targetWMunique = findUnique(WMforTargetElements_flat)

resultDict = {
"TargetElements": targetElements,
"TargetFamilyCode": targetFamilyCode,
"WMforTargetElements": WMforTargetElements,
"TargetWMunique": targetWMunique
}



result = resultDict

# Assign your output to the OUT variable.
OUT = result
# ----------------------------------------

watch = Watch(select_target_family_element_and)
code_block_6 = CodeBlock(i=watch) { i; }

# group: Input Manager
value_for_import_from_others = CodeBlock(MainInput=code_block_6) { MainInput; RefInput1; RefInput2; }  # unwired: RefInput1, RefInput2

# group: <Func 9>Lean Concrete
code_block_7 = CodeBlock { "TargetElements"; }
valueAtKey = DesignScript.Builtin.Dictionary.ValueAtKey(dictionary=value_for_import_from_others.MainInput, key=code_block_7)
code_block_8 = CodeBlock { 0; 100; }
# note: <Func>
createLeanConcrete = Custom[CreateLeanConcrete](Element=valueAtKey, leanOffset=code_block_8.out0, leanThick=code_block_8.out1)  # CreateLeanConcreteForISOFDN
volume = Solid.Volume(solid=createLeanConcrete.Solid)
code_block_9 = CodeBlock(i=volume) { Math.Round(List.Flatten(i)/1000000000, 2); }
code_block_10 = CodeBlock { "M3"; }
count = List.Count(list=code_block_9)
ofRepeatedItem = List.OfRepeatedItem(item=code_block_10, amount=count)
code_block_11 = CodeBlock(FuncValues=code_block_9, FuncValuesUnit=ofRepeatedItem)
# ---------- code_block_11.designscript (4 lines) ----------
{
"FuncValues": _FuncValues,
"FuncValuesUnit": _FuncValuesUnit
};
# ----------------------------------------

# group: Output Manager
output = CodeBlock(MainOutput=code_block_11, RefOutput_geoColor=createLeanConcrete.Solid) { MainOutput; RefOutput_geoColor; }
reference_output = CodeBlock(ref=createLeanConcrete.Solid) { ref; }

# group: Visual Manager
visual_켜기_끄기 = BoolSelector(false)
visual_manager = Python(IN[0]=output.RefOutput_geoColor, IN[1]=visual_켜기_끄기)  # CPython3
# ---------- visual_manager.python (18 lines) ----------
# Load the Python Standard and DesignScript Libraries
import sys
import clr
clr.AddReference('ProtoGeometry')
from Autodesk.DesignScript.Geometry import *

# The inputs to this node will be stored as a list in the IN variables.
dataEnteringNode = IN
geoColors = IN[0]
blnForVisual = IN[1]

# Place your code below this line
if blnForVisual == True:
    result = geoColors
else:
    result = 0
# Assign your output to the OUT variable.
OUT = result
# ----------------------------------------

join = List.Join(list0=output.MainOutput)  # unwired: list1, list2, list3, list4, list5, list6, list7, list8, list9, list10

# group: TargetWMunique + Data Sending
code_block_12 = CodeBlock(InputDic2=join) { _InputDic2; }
count_2 = List.Count(list=code_block_12)
code_block_13 = CodeBlock(InputDic1=code_block_6) { _InputDic1; }
code_block_14 = CodeBlock { "TargetWMunique"; }
valueAtKey_2 = DesignScript.Builtin.Dictionary.ValueAtKey(dictionary=code_block_13, key=code_block_14)
watch_2 = Watch(valueAtKey_2)
count_3 = List.Count(list=watch_2)
eq = count_2 == count_3
organizeFuncValuesAndWorkMasterAsDiction = Custom[OrganizeFuncValuesAndWorkMasterAsDictionary](InputDic1=code_block_13, InputDic2=code_block_12)  # Organize FuncValues and WorkMaster As Dictionary
watch_3 = Watch()  # unwired: arg0
if_ = If(test=eq, true=organizeFuncValuesAndWorkMasterAsDiction, false=watch_3)

# group: Sample
code_block_15 = CodeBlock {  }
code_block_16 = CodeBlock {  }

# group: 사선 + 하부 모델링 업데이트 및 확정 후 재 확인
code_block_17 = CodeBlock {  }
code_block_18 = CodeBlock {  }

# group: Primary Input : Excel & Revit Elements
categories_2 = Categories("OST_EdgeSlab")
all_elements_of_category_2 = ElementsOfCategory(Category=categories_2)
string_from_web = Python()  # CPython3; unwired: IN[0]
# ---------- string_from_web.python (19 lines) ----------
# Load the Python Standard and DesignScript Libraries
import sys
import clr
clr.AddReference('ProtoGeometry')
from Autodesk.DesignScript.Geometry import *
import urllib.request

# The inputs to this node will be stored as a list in the IN variables.
dataEnteringNode = IN
inputURL = "https://raw.githubusercontent.com/HNANmal/mQ/master/Hdynlib/General/ImportExcel.py"

# Place your code below this line
req = urllib.request
data = req.urlopen(inputURL)

result = data.read().decode("utf-8")

# Assign your output to the OUT variable.
OUT = result
# ----------------------------------------
file_path_2 = Filename(".\BIM_물량집계 자동화 산출기준표_rC(20211207)_강한호 (1).xlsx")  # graph input
sheet_name = CodeBlock { "Slab Edges"; }
github_python_import_excel_by = PythonStringNode(script=string_from_web, IN[0]=file_path_2, IN[1]=sheet_name)  # "Github_Python@Import Excel(By OpenpyXl)"; CPython3
code_block_19 = CodeBlock(InputElement=all_elements_of_category_2, InputData=github_python_import_excel_by) { _InputElement; _InputData; }

# group: GetFull WMCodeDescription PerElement
excelDataManagerNode_2 = Python(IN[0]=code_block_19._InputElement, IN[1]=code_block_19._InputData)  # CPython3
# ---------- excelDataManagerNode_2.python (280 lines) ----------
# Load the Python Standard and DesignScript Libraries
import os
import sys
sys.path.append(os.getenv('LOCALAPPDATA').replace('\\','\\\\') + r'\Programs\Python\Python39\Lib\site-packages')
import clr
clr.AddReference('RevitAPI')
import Autodesk

clr.AddReference('ProtoGeometry')
from Autodesk.DesignScript.Geometry import *

clr.AddReference('RevitNodes')
import Revit
clr.ImportExtensions(Revit.Elements)

clr.ImportExtensions(Revit.GeometryConversion)
clr.ImportExtensions(Revit.GeometryReferences)

clr.AddReference('RevitServices')
import RevitServices
from RevitServices.Persistence import DocumentManager
from RevitServices.Transactions import TransactionManager

doc = DocumentManager.Instance.CurrentDBDocument

import random
import itertools
from functools import reduce
from collections import Iterable
import datetime
import openpyxl

def iterable(obj):
    return isinstance(obj, Iterable)

def findUnique(inputs):
    result = []
    for i in inputs:
        if i in result:
            pass
        else:
            result.append(i)
    return result

# The inputs to this node will be stored as a list in the IN variables.
dataEnteringNode = IN
inputElements = IN[0]
inputData = IN[1]
#inputSheetName = IN[2]

def importExcel(path, SheetNameIn):
    wb_obj = openpyxl.load_workbook(str(path), data_only=True)
    sheet_obj = wb_obj.get_sheet_by_name(str(SheetNameIn))

    m_row = sheet_obj.max_row
    m_col = sheet_obj.max_column

    listOut = []

    for i in range(1, m_row +1):
        listTemp = []
        for j in range(1, m_col + 1):
            cell_obj = sheet_obj.cell(row=i, column=j)
            listTemp.append(cell_obj.value)
            if len(listTemp) == m_col:
                listOut.append(listTemp)
    return listOut

def getUsedFamilyTypeOfModeling(elements):
    familyCode = list(map(lambda x: x.Name.split('_')[0], elements))
    unq_familyCode = findUnique(familyCode)
    return unq_familyCode
    
def createExcelDataDictionary(values):
    result = {}
    for i in range(len(values)):
        result[str(i)] = values[i]
    return result

def findTargetIndex(targets, list):
    result = []
    for target in targets:
        for i in range(len(list)):
            if target in str(list[i]):
                result.append(i)
            else:
                pass
    result.sort()
    return result
    
def GetValueAtKeys(keys, dictionary):
    result = [] 
    for i in keys:
        result.append(dictionary[str(i)])
    return result


# Place your code below this line
usedFamilyTypeOfModeling = getUsedFamilyTypeOfModeling(inputElements)
excelWholeDataSet = inputData#importExcel(inputFilePath, inputSheetName)
trExcelWholeDataSet = list(zip(*excelWholeDataSet))
excelColumnDataSet = createExcelDataDictionary(trExcelWholeDataSet)
excelRowDataSet = createExcelDataDictionary(excelWholeDataSet)
ColumnIndexOfUsedFamilyType = findTargetIndex(usedFamilyTypeOfModeling, trExcelWholeDataSet)
ColDataSetOfUsedFamilyType = GetValueAtKeys(ColumnIndexOfUsedFamilyType, excelColumnDataSet)
materialPerElementFromModeling = []
for i in inputElements:
    materialPerElementFromModeling.append(i.GetMaterials())
#list(map(lambda x: x.GetMaterials, inputElements)) "맵함수로 처리하면 리스트화 할 때 타입 변환 오류 남"

targetWMRowIndex = []
for i in ColDataSetOfUsedFamilyType:
    targetWMRowIndex.append(findTargetIndex(['000'], i))

rowDataSetOfUsedWM = []
for i in targetWMRowIndex:
    rowDataSetOfUsedWM.append(GetValueAtKeys(i, excelRowDataSet))

workGroup = []
for i in rowDataSetOfUsedWM:
    tmp = []
    for j in i:
        tmp.append(j[0])
    workGroup.append(tmp)
    
workMaster = []
for i in range(len(ColDataSetOfUsedFamilyType)):
    tmp=[]
    for k in targetWMRowIndex[i]:
        tmp.append(ColDataSetOfUsedFamilyType[i][k])
    workMaster.append(tmp)

matchedWM = []
for i in range(len(workGroup)):
    tmp = []
    for j in range(len(workGroup[i])):
        fullWM = workGroup[i][j] +"-"+ workMaster[i][j]
        tmp.append(fullWM)
    matchedWM.append(tmp)

matchedWorkGruopAndMasterCode = []
for i in matchedWM:
    if len(i) > 0:
        matchedWorkGruopAndMasterCode.append(i)
    else:
        pass

matchedWMDescription = []
for i in rowDataSetOfUsedWM:
    tmp=[]
    for j in i:
        tmp.append(j[1] +" "+ j[2] +" "+ j[3] +" "+ "("+ j[4] +")")
    if len(tmp) > 0:
        matchedWMDescription.append(tmp)
    else:
        pass

matchedWMUnit = []
for i in rowDataSetOfUsedWM:
    tmp=[]
    for j in i:
        tmp.append(j[4])
    if len(tmp) > 0:
        matchedWMUnit.append(tmp)
    else:
        pass

matchedWorkGruopAndMasterCode_flat = list(itertools.chain(*matchedWorkGruopAndMasterCode))
matchedWMDescription_flat = list(itertools.chain(*matchedWMDescription))

dic_WMandDescription_Excel = {}
for i in range(len(matchedWorkGruopAndMasterCode_flat)):
    dic_WMandDescription_Excel[matchedWorkGruopAndMasterCode_flat[i]] = matchedWMDescription_flat[i]

usedFamilyTypeInExcelOrder = list(map(lambda x: x[3], ColDataSetOfUsedFamilyType))
usedFamilyCodeInExcelOrder = findUnique(list(map(lambda x: x.split('_')[0], usedFamilyTypeInExcelOrder)))
#usedFamilyCodeInExcelOrder = findUnique(list(map(lambda x: , usedFamilyTypeInExcelOrder))) ##slab edge 용 임시 작성

dic_FamilyCodeandWM = {}
for i in range(len(usedFamilyCodeInExcelOrder)):
    dic_FamilyCodeandWM[usedFamilyCodeInExcelOrder[i]] = matchedWorkGruopAndMasterCode[i]

workMasterCodePerElement = []
familyCodePerElem = list(map(lambda x: x.Name.split('_')[0], inputElements))
for i in familyCodePerElem:
    workMasterCodePerElement.append(dic_FamilyCodeandWM[i])

materialNamePerElem = []
for i in materialPerElementFromModeling:
    tmp = []
    for j in i:
        tmp.append(j.Name)
    materialNamePerElem.append(tmp)

WMPerElementFromModeling = []
for i in materialNamePerElem:
    tmp = []
    for j in i:
        tmp.append(j.split('_')[0])
    WMPerElementFromModeling.append(tmp)

specPerElementFromModeling = []
for i in materialNamePerElem:
    tmp = []
    for j in i:
        a = j.split('_')
        del a[0]
        b = " ".join(a)
        tmp.append(b)
    specPerElementFromModeling.append(tmp)

WMPerElementFromModeling_flat = list(itertools.chain(*WMPerElementFromModeling))
specPerElementFromModeling_flat = list(itertools.chain(*specPerElementFromModeling))

dic_WMandDescription_Model = {}
for i in range(len(WMPerElementFromModeling_flat)):
    dic_WMandDescription_Model[WMPerElementFromModeling_flat[i]] = specPerElementFromModeling_flat[i]

def findAllKeys(dict):
    result = []
    for key in dict.keys():
        result.append(key)
    return result

def findAllValues(dict):
    result = []
    for key in dict.keys():
        result.append(dict[key])
    return result

keys_WMandDescription_Model = findAllKeys(dic_WMandDescription_Model)
keys_WMandDescription_Excel = findAllKeys(dic_WMandDescription_Excel)

keys_WMandDescription_Both = list(set(keys_WMandDescription_Model + keys_WMandDescription_Excel))
values_WMandDescription_Both = []
for i in keys_WMandDescription_Both:
    if i in keys_WMandDescription_Model:
        values_WMandDescription_Both.append(dic_WMandDescription_Model[i])
    else:
        values_WMandDescription_Both.append(dic_WMandDescription_Excel[i])

dic_WMandDescription_Both = {}
for i in range(len(keys_WMandDescription_Both)):
    dic_WMandDescription_Both[keys_WMandDescription_Both[i]] = values_WMandDescription_Both[i]

workMasterCodePerElementFromBoth = []
for i in range(len(workMasterCodePerElement)):
    #tmp = []
    a = WMPerElementFromModeling[i] + workMasterCodePerElement[i]
    b = findUnique(a)
    workMasterCodePerElementFromBoth.append(b)

specPerElement = []
for i in workMasterCodePerElementFromBoth:
    tmp = []
    for j in i:
        tmp.append(dic_WMandDescription_Both[j])
    specPerElement.append(tmp)

fullWMCodeDescriptionPerElement = []
for i in range(len(workMasterCodePerElementFromBoth)):
    tmp = []
    for j in range(len(workMasterCodePerElementFromBoth[i])):
        a = workMasterCodePerElementFromBoth[i][j] +": "+ specPerElement[i][j]
        tmp.append(a)
    fullWMCodeDescriptionPerElement.append(tmp)

fullWMinfo = {
"AllElement": inputElements,
"WorkMasterCodePerFamilyType": dic_FamilyCodeandWM,
"WorkMasterCodePerElementBoth": workMasterCodePerElementFromBoth,
"FullWMCodeDescriptionPerElement": fullWMCodeDescriptionPerElement
}



result = fullWMinfo

# Assign your output to the OUT variable.
OUT = result
# ----------------------------------------

# group: OrganizeAllElementInformAsDictionary
organizeAllElementInformAsDictionary = Custom[OrganizeAllElementInformAsDictionary](InputDic=excelDataManagerNode_2)  # OrganizeAllElementInformAsDictionary

# group: Select Target Family Element And Connected WorkMasters
code_block_20 = CodeBlock { 0; }
selectTargetFamilyInformAsDictionary = Custom[SelectTargetFamilyInformAsDictionary](InputDic=organizeAllElementInformAsDictionary, InputIndex=code_block_20)  # Select Target Family Element And Connected WorkMasters

watch_4 = Watch(selectTargetFamilyInformAsDictionary)
code_block_21 = CodeBlock(i=watch_4) { i; }

# group: <Func 2> 측면 면적산출
code_block_22 = CodeBlock { "TargetElements"; }
valueAtKey_3 = DesignScript.Builtin.Dictionary.ValueAtKey(dictionary=code_block_21, key=code_block_22)
# note: <Func>
geometry = Element.Geometry(element=valueAtKey_3@L1)
extractSideFacesOfElement = Custom[ExtractSideFacesOfElement](Element=valueAtKey_3)  # ExtractSideFacesOfElement
flatten = List.Flatten(list=extractSideFacesOfElement.Surface)
area = Surface.Area(surface=flatten)
sum = Math.Sum(values=area)
code_block_23 = CodeBlock(i=sum) { Math.Round(List.Flatten(i)/1000000, 2); }
code_block_24 = CodeBlock { "M2"; }
count_4 = List.Count(list=code_block_23)
ofRepeatedItem_2 = List.OfRepeatedItem(item=code_block_24, amount=count_4)
code_block_25 = CodeBlock(FuncValues=code_block_23, FuncValuesUnit=ofRepeatedItem_2)  # same code as code_block_11

code_block_26 = CodeBlock(a=geometry) { a[1]; }
explode = Geometry.Explode(geometry=code_block_26)
area_2 = Surface.Area(surface=explode)
round = Math.Round(number=area_2)
uniqueItems = List.UniqueItems(list=round)
code_block_27 = CodeBlock { 150000; }
gt = code_block_27 > round
filterByBoolMask = List.FilterByBoolMask(list=explode, mask=gt)
flatten_2 = List.Flatten(list=filterByBoolMask.in)
perimeterCurves = Surface.PerimeterCurves(surface=flatten_2)
code_block_28 = CodeBlock { 0.5; }
pointAtParameter = Surface.PointAtParameter(surface=flatten_2, u=code_block_28, v=code_block_28)
startPoint = Curve.StartPoint(curve=perimeterCurves)
byStartPointEndPoint = Line.ByStartPointEndPoint(startPoint=pointAtParameter, endPoint=startPoint)
length = Curve.Length()  # unwired: curve
minimumItemByKey = List.MinimumItemByKey(list=byStartPointEndPoint@L2, keyFunction=length)
doesIntersect = Geometry.DoesIntersect(geometry=minimumItemByKey, other=perimeterCurves)
filterByBoolMask_2 = List.FilterByBoolMask(list=perimeterCurves, mask=doesIntersect)
flatten_3 = List.Flatten(list=filterByBoolMask_2.in)
watch_5 = Watch(flatten_3)
count_5 = List.Count(list=watch_5)
code_block_29 = CodeBlock(a=count_5) { (2-a); }
dropItems = List.DropItems(list=watch_5, amount=code_block_29)
endPoint = Curve.EndPoint(curve=dropItems)
code_block_30 = CodeBlock { -1; }
dropItems_2 = List.DropItems(list=endPoint, amount=code_block_30)
startPoint_2 = Curve.StartPoint(curve=dropItems)
join_2 = List.Join(list0=dropItems_2, list1=startPoint_2)
byPoints = PolyCurve.ByPoints(points=join_2)
watch_6 = Watch(extractSideFacesOfElement.Surface)
watch_7 = Watch(watch_6)
code_block_31 = CodeBlock { 1; }
flatten_4 = List.Flatten(list=watch_7, amount=code_block_31)
code_block_32 = CodeBlock(a=flatten_4) { a[1]; }
explode_2 = Geometry.Explode(geometry=code_block_32)
perimeterCurves_2 = Surface.PerimeterCurves(surface=explode_2)
flatten_5 = List.Flatten(list=perimeterCurves_2)
length_2 = Curve.Length(curve=flatten_5)
code_block_33 = CodeBlock { 600; }
gt_2 = length_2 > code_block_33
filterByBoolMask_3 = List.FilterByBoolMask(list=flatten_5, mask=gt_2)
flatten_6 = List.Flatten(list=filterByBoolMask_3.in)
extractUpperFacesOfElement = Custom[ExtractUpperFacesOfElement](Element=valueAtKey_3)  # ExtractUpperFacesOfElement
watch_8 = Watch(extractUpperFacesOfElement.Surface)
flatten_7 = List.Flatten(list=watch_8)
byJoinedSurfaces = PolySurface.ByJoinedSurfaces(surfaces=flatten_7)
doesIntersect_2 = Geometry.DoesIntersect(geometry=byJoinedSurfaces, other=flatten_6, lacing=CrossProduct)
filterByBoolMask_4 = List.FilterByBoolMask(list=flatten_6, mask=doesIntersect_2@L2)
flatten_8 = List.Flatten(list=filterByBoolMask_4.in)
byJoinedCurves = PolyCurve.ByJoinedCurves(curves=flatten_8)
bySweep = Surface.BySweep(profile=byPoints, path=byJoinedCurves)
watch_9 = Watch(geometry)
flatten_9 = List.Flatten(list=watch_9)
explode_3 = Geometry.Explode(geometry=flatten_9)
code_block_34 = CodeBlock { 150000; }
area_3 = Surface.Area(surface=explode_3)
round_2 = Math.Round(number=area_3)
gt_3 = code_block_34 > round_2
filterByBoolMask_5 = List.FilterByBoolMask(list=explode_3, mask=gt_3)
watch_10 = Watch(filterByBoolMask_5.in)
perimeterCurves_3 = Surface.PerimeterCurves(surface=watch_10)
code_block_35 = CodeBlock { 0.5; }
pointAtParameter_2 = Surface.PointAtParameter(surface=watch_10, u=code_block_35, v=code_block_35)
startPoint_3 = Curve.StartPoint(curve=perimeterCurves_3)
byStartPointEndPoint_2 = Line.ByStartPointEndPoint(startPoint=pointAtParameter_2, endPoint=startPoint_3)
length_3 = Curve.Length()  # unwired: curve
minimumItemByKey_2 = List.MinimumItemByKey(list=byStartPointEndPoint_2@L2, keyFunction=length_3)
count_6 = List.Count(list=byStartPointEndPoint_2)
chop = List.Chop(list=minimumItemByKey_2, lengths=count_6)
doesIntersect_3 = Geometry.DoesIntersect(geometry=chop@L2, other=perimeterCurves_3@L3)
filterByBoolMask_6 = List.FilterByBoolMask(list=perimeterCurves_3@L3, mask=doesIntersect_3@L3)
watch_11 = Watch(filterByBoolMask_6.in)
flatten_10 = List.Flatten(list=filterByBoolMask_6.in)
watch_12 = Watch(flatten_10)
code_block_36 = CodeBlock { 2; }
dropItems_3 = List.DropItems(list=watch_12, amount=code_block_36)
endPoint_2 = Curve.EndPoint(curve=dropItems_3)
code_block_37 = CodeBlock { -1; }
dropItems_4 = List.DropItems(list=endPoint_2, amount=code_block_37)
startPoint_4 = Curve.StartPoint(curve=dropItems_3)
join_3 = List.Join(list0=dropItems_4, list1=startPoint_4)
byPoints_2 = PolyCurve.ByPoints(points=join_3)
uniqueItems_2 = List.UniqueItems(list=round_2)
flatten_11 = List.Flatten(list=filterByBoolMask_5.in)
watch_13 = Watch(extractSideFacesOfElement.Surface)
watch_14 = Watch(watch_13)
code_block_38 = CodeBlock { 1; }
flatten_12 = List.Flatten(list=watch_14, amount=code_block_38)
code_block_39 = CodeBlock(a=flatten_12) { a[0]; }
explode_4 = Geometry.Explode(geometry=code_block_39)
perimeterCurves_4 = Surface.PerimeterCurves(surface=explode_4)
flatten_13 = List.Flatten(list=perimeterCurves_4)
length_4 = Curve.Length(curve=flatten_13)
uniqueItems_3 = List.UniqueItems(list=length_4)
watch_15 = Watch(uniqueItems_3)
sort = List.Sort(list=watch_15)
watch_16 = Watch(sort)

# group: <Func 1> 콘크리트 체적
code_block_40 = CodeBlock { "TargetElements"; }
valueAtKey_4 = DesignScript.Builtin.Dictionary.ValueAtKey(dictionary=code_block_21, key=code_block_40)
# note: <Func>
geometry_2 = Element.Geometry(element=valueAtKey_4)
flatten_14 = List.Flatten(list=geometry_2@L2)
volume_2 = Solid.Volume(solid=flatten_14)
flatten_15 = List.Flatten(list=volume_2)
sum_2 = Math.Sum(values=flatten_15)
code_block_41 = CodeBlock(i=sum_2) { Math.Round(List.Flatten(i)/1000000000, 2); }
code_block_42 = CodeBlock { "M3"; }
count_7 = List.Count(list=code_block_41)
ofRepeatedItem_3 = List.OfRepeatedItem(item=code_block_42, amount=count_7)
code_block_43 = CodeBlock(FuncValues=code_block_41, FuncValuesUnit=ofRepeatedItem_3)  # same code as code_block_11

# group: <Func 2> 터파기 물량 콘크리트 체적의 1.2
code_block_44 = CodeBlock(a=code_block_41) { a*1.2; }
code_block_45 = CodeBlock { "M3"; }
count_8 = List.Count(list=code_block_44)
ofRepeatedItem_4 = List.OfRepeatedItem(item=code_block_45, amount=count_8)
code_block_46 = CodeBlock(FuncValues=code_block_44, FuncValuesUnit=ofRepeatedItem_4)  # same code as code_block_11

watch_17 = Watch(code_block_46)

# group: <Func 4> 콘크리트 체적의 0.1(ton)
watch_18 = Watch(code_block_41)
code_block_47 = CodeBlock(a=watch_18) { a*0.1; }
watch_19 = Watch(code_block_47)
code_block_48 = CodeBlock { "ton"; }
count_9 = List.Count(list=watch_19)
ofRepeatedItem_5 = List.OfRepeatedItem(item=code_block_48, amount=count_9)
code_block_49 = CodeBlock(FuncValues=watch_19, FuncValuesUnit=ofRepeatedItem_5)  # same code as code_block_11

watch_20 = Watch(code_block_49)

# group: <Func 3> Excavation 물량에 20% , Excavation 물량에 80%
watch_21 = Watch(code_block_44)
code_block_50 = CodeBlock(a=watch_21) { a*0.2; a*0.8; }
# note: Disposal
watch_22 = Watch(code_block_50.out1)
code_block_51 = CodeBlock { "M3"; }
count_10 = List.Count(list=watch_22)
ofRepeatedItem_6 = List.OfRepeatedItem(item=code_block_51, amount=count_10)
code_block_52 = CodeBlock(FuncValues=watch_22, FuncValuesUnit=ofRepeatedItem_6)  # same code as code_block_11
# note: Backfill
watch_23 = Watch(code_block_50.out0)
code_block_53 = CodeBlock { "M3"; }
count_11 = List.Count(list=watch_23)
ofRepeatedItem_7 = List.OfRepeatedItem(item=code_block_53, amount=count_11)
code_block_54 = CodeBlock(FuncValues=watch_23, FuncValuesUnit=ofRepeatedItem_7)  # same code as code_block_11

watch_24 = Watch(code_block_52)
watch_25 = Watch(code_block_54)
watch_26 = Watch(code_block_25)
watch_27 = Watch(code_block_43)
join_4 = List.Join()  # unwired: list0

# group: TargetWMunique + Data Sending
code_block_55 = CodeBlock(InputDic2=join_4) { _InputDic2; }
count_12 = List.Count(list=code_block_55)
code_block_56 = CodeBlock(InputDic1=code_block_21) { _InputDic1; }
code_block_57 = CodeBlock { "TargetWMunique"; }
valueAtKey_5 = DesignScript.Builtin.Dictionary.ValueAtKey(dictionary=code_block_56, key=code_block_57)
watch_28 = Watch(valueAtKey_5)
count_13 = List.Count(list=watch_28)
eq_2 = count_12 == count_13
organizeFuncValuesAndWorkMasterAsDiction_2 = Custom[OrganizeFuncValuesAndWorkMasterAsDictionary](InputDic1=code_block_56, InputDic2=code_block_55)
watch_29 = Watch()  # unwired: arg0
if_2 = If(test=eq_2, true=organizeFuncValuesAndWorkMasterAsDiction_2, false=watch_29)

# group: 데이터 취합 및 Row 방향 정렬
code_block_58 = CodeBlock(InputDic=if_2) { _InputDic; }
code_block_59 = CodeBlock { "TrTargetFamilyCode"; }
valueAtKey_6 = DesignScript.Builtin.Dictionary.ValueAtKey(dictionary=code_block_58, key=code_block_59)
watch_30 = Watch(valueAtKey_6)
flatten_16 = List.Flatten(list=watch_30)
code_block_60 = CodeBlock { "WMforTargetElements"; }
valueAtKey_7 = DesignScript.Builtin.Dictionary.ValueAtKey(dictionary=code_block_58, key=code_block_60)
watch_31 = Watch(valueAtKey_7)
flatten_17 = List.Flatten(list=watch_31)
code_block_61 = CodeBlock { "TargetFuncValues"; }
valueAtKey_8 = DesignScript.Builtin.Dictionary.ValueAtKey(dictionary=code_block_58, key=code_block_61)
watch_32 = Watch(valueAtKey_8)
flatten_18 = List.Flatten(list=watch_32)
code_block_62 = CodeBlock { "TargetFuncValuesUnit"; }
valueAtKey_9 = DesignScript.Builtin.Dictionary.ValueAtKey(dictionary=code_block_58, key=code_block_62)
watch_33 = Watch(valueAtKey_9)
flatten_19 = List.Flatten(list=watch_33)
list_create = List.Create(item0=flatten_16, item1=flatten_17, item2=flatten_18, item3=flatten_19)
transpose = List.Transpose(lists=list_create)

# group: 패밀리 별 취합 + Export Excel(By OpenpyXl)
# note: Excel Export Button
boolean = BoolSelector(true)
join_5 = List.Join(list0=transpose)
watch_34 = Watch()  # unwired: arg0
if_3 = If(test=boolean, true=join_5, false=watch_34)
python_script_export_excel_by = Python(IN[0]=if_3)  # "Python Script@Export Excel(By OpenpyXl)"; CPython3
# ---------- python_script_export_excel_by.python (151 lines) ----------
# Load the Python Standard and DesignScript Libraries
import sys
import os
#sys.path.append(r'C:\Users\HEC\AppData\Local\Programs\Python\Python39\Lib\site-packages')
#sys.path.append(r'C:\Users\pjmk0\AppData\Local\Programs\Python\Python39\Lib\site-packages')
sys.path.append(os.getenv('LOCALAPPDATA').replace('\\','\\\\') + r'\Programs\Python\Python39\Lib\site-packages')
import clr
clr.AddReference('ProtoGeometry')
from Autodesk.DesignScript.Geometry import *
from collections import Iterable

def iterable(obj):
    return isinstance(obj, Iterable)


# The inputs to this node will be stored as a list in the IN variables.
dataEnteringNode = IN
ListIn = IN[0]

# Place your code below this line
import datetime
from datetime import date, timedelta
Today = date.today()
import openpyxl
from openpyxl.styles import Border, Side, PatternFill, Font, GradientFill, Alignment, Color, numbers

sample_items = ListIn


def write_to_file(filepath):
    wb = openpyxl.Workbook()
    for sheet in wb.sheetnames:
        wb.remove(wb[sheet])

    thin = Side(border_style="thin", color="000000")
    double = Side(border_style="double", color="000000")

    ws = wb.create_sheet(title='Wall_Calc_instance', index=0)

    ws.merge_cells('A1:L1')
    ws['A1'] = 'HEC Wall Category Calculation Sheet'
    cell = ws['A1']
    cell.font = openpyxl.styles.Font(color='000000', size=20)
    cell.fill = openpyxl.styles.fills.PatternFill(patternType='solid',
                                                  fgColor=openpyxl.styles.colors.Color(rgb='fff3b0'))

    ws['A2'] = 'Item Number'
    ws['A2'].font = openpyxl.styles.Font(b=True, color='000000', size=12)
    #ws['B2'] = 'Member Name'
    #ws['B2'].font = openpyxl.styles.Font(b=True, color='000000', size=12)
    #ws['C2'] = 'Category'
    #ws['C2'].font = openpyxl.styles.Font(b=True, color='000000', size=12)
    ws['B2'] = 'Family Type'
    ws['B2'].font = openpyxl.styles.Font(b=True, color='000000', size=12)
    ws['C2'] = 'WorkMaster Code'
    ws['C2'].font = openpyxl.styles.Font(b=True, color='000000', size=12)
    #ws['F2'] = 'WorkMaster Description'
    #ws['F2'].font = openpyxl.styles.Font(b=True, color='000000', size=12)
    #ws['G2'] = 'Unit'
    #ws['G2'].font = openpyxl.styles.Font(b=True, color='000000', size=12)
    #ws['H2'] = '계수'
    #ws['H2'].font = openpyxl.styles.Font(b=True, color='000000', size=12)
    #ws['I2'] = '계산 참조값'
    #ws['I2'].font = openpyxl.styles.Font(b=True, color='000000', size=12)
    ws['D2'] = 'Quantities'
    ws['D2'].font = openpyxl.styles.Font(b=True, color='000000', size=12)
    ws['E2'] = 'Unit'
    ws['E2'].font = openpyxl.styles.Font(b=True, color='000000', size=12)
    ws['F2'] = 'Unit Price'
    ws['F2'].font = openpyxl.styles.Font(b=True, color='000000', size=12)
    ws['G2'] = 'Total Price'
    ws['G2'].font = openpyxl.styles.Font(b=True, color='000000', size=12)


## 칼럼별 너비 조정 구간
#    for col in range(ws.max_column):
#        ws.column_dimensions[chr(ord('A') + col)].width = 15
    ws.column_dimensions['A'].width = 15
    ws.column_dimensions['B'].width = 45
    ws.column_dimensions['C'].width = 60
    ws.column_dimensions['D'].width = 20
    ws.column_dimensions['E'].width = 20
    ws.column_dimensions['F'].width = 20
    ws.column_dimensions['G'].width = 20
    #ws.column_dimensions['G'].width = 9
    #ws.column_dimensions['H'].width = 9
    #ws.column_dimensions['H'].hidden = True
    #ws.column_dimensions['I'].width = 12
    #ws.column_dimensions['I'].hidden = True
    #ws.column_dimensions['J'].width = 12
    #ws.column_dimensions['K'].width = 12
    #ws.column_dimensions['L'].width = 12

###
    start_row = 3
    for (row, item) in enumerate(sample_items, start_row):
        cell = ws.cell(row=row, column=1, value=row - 2)
        cell.alignment = openpyxl.styles.Alignment(horizontal='center', vertical='center')

#        cell = ws.cell(row=row, column=2, value=item[0])
#        cell.number_format = openpyxl.styles.numbers.FORMAT_DATE_YYYYMMDD2  # 'yyyy-mm-dd'
        ws.cell(row=row, column=2, value=item[0]) ## Family Type 칼럼

        ws.cell(row=row, column=3, value=item[1]) ## WorkMaster Code 칼럼
        
        ws.cell(row=row, column=4, value=item[2]) ## Quantities 칼럼
        
        ws.cell(row=row, column=5, value=item[3]) ## Unit 칼럼
        
        #cell = ws.cell(row=row, column=8, value=item[6]) ## 계수 칼럼
        #cell.number_format = openpyxl.styles.numbers.builtin_format_code(3)  # '#,##0'
        
        #cell = ws.cell(row=row, column=9, value=item[7]) ## 계산 참조값 칼럼
        #cell.number_format = openpyxl.styles.numbers.builtin_format_code(3)  # '#,##0'
        
        #cell = ws.cell(row=row, column=10, value=item[8]) ## Quantities 칼럼
        #cell.number_format = openpyxl.styles.numbers.builtin_format_code(3)  # '#,##0'
        #cell.font = openpyxl.styles.Font(b=True, color='000000', size=11)

        cell = ws.cell(row=row, column=7, value='= D{current_row}*F{current_row}'.format(current_row=cell.row))
        cell.number_format = '#,##0'

#        cell = ws.cell(row=row, column=6, value='= D{current_row} * E{current_row}'.format(current_row=cell.row))
#        cell.number_format = openpyxl.styles.numbers.builtin_format_code(3)

    total_row = ws.max_row + 1
    if total_row > start_row:
        cell1 = ws.cell(row=total_row, column=6, value='Total')
        cell1.font = openpyxl.styles.Font(b=True, color='000000', size=15)
        
        cell2 = ws.cell(row=total_row, column=7, value='= SUM(G{}:G{})'.format(start_row, total_row - 1))
        cell2.number_format = openpyxl.styles.numbers.builtin_format_code(3)
        cell2.border = Border(top=double, left=double, right=double, bottom=double)
        cell2.font = openpyxl.styles.Font(b=True, color='ff03ce', size=15)
    

    wb.save(filepath)
    wb.close()


##if __name__ == '__main__':
#write_to_file('C:\\Users\\pjmk0\\AppData\\Roaming\\test.xlsx')

save_name = "HecStrFDNCalcSheet_" + Today.strftime("%Y-%m-%d")+".xlsx"
path = os.getenv('APPDATA').replace('\\','\\\\')
filePath = path + '\\' + save_name

write_to_file(filePath)

# Assign your output to the OUT variable.
OUT = os.getenv('APPDATA')
# ----------------------------------------

uniqueItems_4 = List.UniqueItems(list=length_2)
watch_35 = Watch(uniqueItems_4)
sort_2 = List.Sort(list=watch_35)
watch_36 = Watch(sort_2)
code_block_63 = CodeBlock(a=geometry) { a[0]; }
explode_5 = Geometry.Explode(geometry=code_block_63)
code_block_64 = CodeBlock { 150000; }
area_4 = Surface.Area(surface=explode_5)
round_3 = Math.Round(number=area_4)
gt_4 = code_block_64 > round_3
filterByBoolMask_7 = List.FilterByBoolMask(list=explode_5, mask=gt_4)
flatten_20 = List.Flatten(list=filterByBoolMask_7.in)
perimeterCurves_5 = Surface.PerimeterCurves(surface=flatten_20)
code_block_65 = CodeBlock { 0.5; }
pointAtParameter_3 = Surface.PointAtParameter(surface=flatten_20, u=code_block_65, v=code_block_65)
startPoint_5 = Curve.StartPoint(curve=perimeterCurves_5)
byStartPointEndPoint_3 = Line.ByStartPointEndPoint(startPoint=pointAtParameter_3, endPoint=startPoint_5)
length_5 = Curve.Length()  # unwired: curve
minimumItemByKey_3 = List.MinimumItemByKey(list=byStartPointEndPoint_3@L2, keyFunction=length_5)
doesIntersect_4 = Geometry.DoesIntersect(geometry=minimumItemByKey_3, other=perimeterCurves_5)
filterByBoolMask_8 = List.FilterByBoolMask(list=perimeterCurves_5, mask=doesIntersect_4)
flatten_21 = List.Flatten(list=filterByBoolMask_8.in)
watch_37 = Watch(flatten_21)
code_block_66 = CodeBlock { 2; }
dropItems_5 = List.DropItems(list=watch_37, amount=code_block_66)
endPoint_3 = Curve.EndPoint(curve=dropItems_5)
code_block_67 = CodeBlock { -1; }
dropItems_6 = List.DropItems(list=endPoint_3, amount=code_block_67)
startPoint_6 = Curve.StartPoint(curve=dropItems_5)
join_6 = List.Join(list0=dropItems_6, list1=startPoint_6)
byPoints_3 = PolyCurve.ByPoints(points=join_6)
code_block_68 = CodeBlock { 600; }
gt_5 = length_4 > code_block_68
filterByBoolMask_9 = List.FilterByBoolMask(list=flatten_13, mask=gt_5)
flatten_22 = List.Flatten(list=filterByBoolMask_9.in)
watch_38 = Watch(extractUpperFacesOfElement.Surface)
flatten_23 = List.Flatten(list=watch_38)
byJoinedSurfaces_2 = PolySurface.ByJoinedSurfaces(surfaces=flatten_23)
doesIntersect_5 = Geometry.DoesIntersect(geometry=byJoinedSurfaces_2, other=flatten_22, lacing=CrossProduct)
filterByBoolMask_10 = List.FilterByBoolMask(list=flatten_22, mask=doesIntersect_5@L2)
flatten_24 = List.Flatten(list=filterByBoolMask_10.in)
byJoinedCurves_2 = PolyCurve.ByJoinedCurves(curves=flatten_24)
bySweep_2 = Surface.BySweep(profile=byPoints_3, path=byJoinedCurves_2)
uniqueItems_5 = List.UniqueItems(list=round_3)

# group: <Func 6,8> 계단과 벽체가 만나는 지점에서 Nosing을 잇는 선을 100mm offset하고 그 경계 하부 면적을 계산
# note: <Func>
code_block_69 = CodeBlock { "TargetElements"; }
valueAtKey_10 = DesignScript.Builtin.Dictionary.ValueAtKey(key=code_block_69)  # unwired: dictionary
area_5 = Surface.Area()  # unwired: surface
sum_3 = Math.Sum(values=area_5)
code_block_70 = CodeBlock(i=sum_3) { Math.Round(List.Flatten(i)/1000000, 2); }
code_block_71 = CodeBlock { "M2"; }
count_14 = List.Count(list=code_block_70)
ofRepeatedItem_8 = List.OfRepeatedItem(item=code_block_71, amount=count_14)
code_block_72 = CodeBlock(FuncValues=code_block_70, FuncValuesUnit=ofRepeatedItem_8)  # same code as code_block_11

geometry_3 = Element.Geometry(element=valueAtKey_10)
explode_6 = Geometry.Explode(geometry=geometry_3)
flatten_25 = List.Flatten(list=explode_6)
# note: <Func>
extractUpperFacesOfElement_2 = Custom[ExtractUpperFacesOfElement](Element=valueAtKey_10)
flatten_26 = List.Flatten(list=extractUpperFacesOfElement_2.Surface)
byJoinedSurfaces_3 = PolySurface.ByJoinedSurfaces(surfaces=flatten_26)
doesIntersect_6 = Geometry.DoesIntersect(geometry=byJoinedSurfaces_3, other=flatten_25, lacing=CrossProduct)
filterByBoolMask_11 = List.FilterByBoolMask(list=flatten_25, mask=doesIntersect_6@L2)
perimeterCurves_6 = Surface.PerimeterCurves(surface=filterByBoolMask_11.out@L1)
startPoint_7 = Curve.StartPoint(curve=perimeterCurves_6)
boolean_2 = BoolSelector(true)
byPoints_4 = PolyCurve.ByPoints(points=startPoint_7, connectLastToFirst=boolean_2)
flatten_27 = List.Flatten(list=filterByBoolMask_11.out)
code_block_73 = CodeBlock { 450; }
translate = Geometry.Translate(geometry=flatten_27, zTranslation=code_block_73)
perimeterCurves_7 = Surface.PerimeterCurves(surface=translate)
startPoint_8 = Curve.StartPoint(curve=perimeterCurves_7)
boolean_3 = BoolSelector(true)
byPoints_5 = PolyCurve.ByPoints(points=startPoint_8, connectLastToFirst=boolean_3)
list_create_2 = List.Create(item0=byPoints_4, item1=byPoints_5)
transpose_2 = List.Transpose(lists=list_create_2)
byLoft = Solid.ByLoft(crossSections=transpose_2)
isNull = Object.IsNull(object=byLoft)
filterByBoolMask_12 = List.FilterByBoolMask(list=byLoft, mask=isNull)
byUnion = Solid.ByUnion(solids=filterByBoolMask_12.out)
geometry_4 = Element.Geometry(element=valueAtKey_10)
flatten_28 = List.Flatten(list=geometry_4)
byUnion_2 = Solid.ByUnion(solids=flatten_28)
differenceAll = Solid.DifferenceAll(solid=byUnion, others=byUnion_2)
explode_7 = Geometry.Explode(geometry=differenceAll)
code_block_74 = CodeBlock { 0.5; }
normalAtParameter = Surface.NormalAtParameter(surface=explode_7, u=code_block_74, v=code_block_74)

# group: func2 (ExtractSideFacesOfElement)
Z = Vector.Z(vector=normalAtParameter)
code_block_75 = CodeBlock { 0; }
round_4 = Math.Round(number=Z, digits=code_block_75)
code_block_76 = CodeBlock(i=round_4) { i<1 && i>-1; }
filterByBoolMask_13 = List.FilterByBoolMask(list=explode_7, mask=code_block_76)
code_block_77 = CodeBlock { GeometryColor; }
code_block_78 = CodeBlock { Surface; }
color_palette = ColorPalette({R: 255, G: 0, B: 255, A: 136})
byGeometryColor = Modifiers.GeometryColor.ByGeometryColor(geometry=filterByBoolMask_13.in, color=color_palette)

watch_39 = Watch(filterByBoolMask_13.in)
separate = Solid.Separate(solid=differenceAll)
doesIntersect_7 = Geometry.DoesIntersect(geometry=separate, other=watch_39, lacing=CrossProduct)
filterByBoolMask_14 = List.FilterByBoolMask(list=watch_39, mask=doesIntersect_7@L2)
watch_40 = Watch(filterByBoolMask_14.in)
watch_41 = Watch(filterByBoolMask_13.out)
separate_2 = Solid.Separate(solid=differenceAll)
doesIntersect_8 = Geometry.DoesIntersect(geometry=separate_2, other=watch_41, lacing=CrossProduct)
filterByBoolMask_15 = List.FilterByBoolMask(list=watch_41, mask=doesIntersect_8@L2)
watch_42 = Watch(filterByBoolMask_15.in)
area_6 = Surface.Area(surface=watch_42)
code_block_79 = CodeBlock { 0; }
round_5 = Math.Round(number=area_6, digits=code_block_79)
area_7 = Surface.Area()  # unwired: surface
minimumItemByKey_4 = List.MinimumItemByKey(list=watch_42@L2, keyFunction=area_7)
watch_43 = Watch(minimumItemByKey_4)
area_8 = Surface.Area(surface=watch_43)
code_block_80 = CodeBlock { 0; }
round_6 = Math.Round(number=area_8, digits=code_block_80)
eq_3 = round_5@L2 == round_6@L1  # lacing=Shortest
filterByBoolMask_16 = List.FilterByBoolMask(list=watch_42@L2, mask=eq_3@L2)
flatten_29 = List.Flatten(list=filterByBoolMask_16.in)
flatten_30 = List.Flatten(list=flatten_29)
countTrue = List.CountTrue(list=eq_3@L2)
code_block_81 = CodeBlock(a=countTrue) { a/2; }
code_block_82 = CodeBlock { 2; }
ofRepeatedItem_9 = List.OfRepeatedItem(item=code_block_81, amount=code_block_82)
transpose_3 = List.Transpose(lists=ofRepeatedItem_9)
flatten_31 = List.Flatten(list=transpose_3)
chop_2 = List.Chop(list=flatten_30, lengths=flatten_31)
code_block_83 = CodeBlock { 0.5; }
pointAtParameter_4 = Surface.PointAtParameter(surface=chop_2, u=code_block_83, v=code_block_83)
byPoints_6 = PolyCurve.ByPoints(points=pointAtParameter_4)
code_block_84 = CodeBlock { 200; }
extendStart = Curve.ExtendStart(curve=byPoints_6, distance=code_block_84)
startPoint_9 = Curve.StartPoint(curve=extendStart)
code_block_85 = CodeBlock { 2; }
chop_3 = List.Chop(list=startPoint_9, lengths=code_block_85)
extendEnd = Curve.ExtendEnd(curve=byPoints_6, distance=code_block_84)
endPoint_4 = Curve.EndPoint(curve=extendEnd)
code_block_86 = CodeBlock { 2; }
chop_4 = List.Chop(list=endPoint_4, lengths=code_block_86)
addItemToFront = List.AddItemToFront(item=chop_3@L2, list=chop_4@L2)
flatten_32 = List.Flatten(list=addItemToFront@L3)
Z_2 = Point.Z()  # unwired: point
sortByFunction = List.SortByFunction(list=flatten_32@L2, sortFunction=Z_2)
byPoints_7 = PolyCurve.ByPoints(points=sortByFunction)
doesIntersect_9 = Geometry.DoesIntersect(geometry=watch_40@L2, other=byPoints_7@L1)
filterByBoolMask_17 = List.FilterByBoolMask(list=watch_40, mask=doesIntersect_9)

# group: <Func 7,9,10> 계단 상부노출면 + Riser 노출면
code_block_87 = CodeBlock { "TargetElements"; }
valueAtKey_11 = DesignScript.Builtin.Dictionary.ValueAtKey(key=code_block_87)  # unwired: dictionary
# note: <Func>
extractUpperFacesOfElement_3 = Custom[ExtractUpperFacesOfElement](Element=valueAtKey_11)
flatten_33 = List.Flatten(list=extractUpperFacesOfElement_3.Surface)
flatten_34 = List.Flatten(list=filterByBoolMask_17.in)
list_create_3 = List.Create(item0=flatten_33, item1=flatten_34)
flatten_35 = List.Flatten(list=list_create_3)
area_9 = Surface.Area(surface=flatten_35)
sum_4 = Math.Sum(values=area_9)
code_block_88 = CodeBlock(i=sum_4) { Math.Round(List.Flatten(i)/1000000, 2); }
code_block_89 = CodeBlock { "M2"; }
count_15 = List.Count(list=code_block_88)
ofRepeatedItem_10 = List.OfRepeatedItem(item=code_block_89, amount=count_15)
code_block_90 = CodeBlock(FuncValues=code_block_88, FuncValuesUnit=ofRepeatedItem_10)  # same code as code_block_11
watch_44 = Watch(code_block_90)

watch_45 = Watch(code_block_72)

# group: <Func 5> 계단 상부노출면
code_block_91 = CodeBlock { "TargetElements"; }
valueAtKey_12 = DesignScript.Builtin.Dictionary.ValueAtKey(key=code_block_91)  # unwired: dictionary
# note: <Func>
extractUpperFacesOfElement_4 = Custom[ExtractUpperFacesOfElement](Element=valueAtKey_12)
flatten_36 = List.Flatten(list=extractUpperFacesOfElement_4.Surface)
area_10 = Surface.Area(surface=flatten_36)
sum_5 = Math.Sum(values=area_10)
code_block_92 = CodeBlock(i=sum_5) { Math.Round(List.Flatten(i)/1000000, 2); }
code_block_93 = CodeBlock { "M2"; }
count_16 = List.Count(list=code_block_92)
ofRepeatedItem_11 = List.OfRepeatedItem(item=code_block_93, amount=count_16)
code_block_94 = CodeBlock(FuncValues=code_block_92, FuncValuesUnit=ofRepeatedItem_11)  # same code as code_block_11

watch_46 = Watch(code_block_94)

# group: <Func 4> 계단 하부노출면
code_block_95 = CodeBlock { "TargetElements"; }
valueAtKey_13 = DesignScript.Builtin.Dictionary.ValueAtKey(key=code_block_95)  # unwired: dictionary
geometry_5 = Element.Geometry(element=valueAtKey_13)
explode_8 = Geometry.Explode(geometry=geometry_5)
flatten_37 = List.Flatten(list=explode_8)
# note: <Func>
extractUpperFacesOfElement_5 = Custom[ExtractUpperFacesOfElement](Element=valueAtKey_13)
flatten_38 = List.Flatten(list=extractUpperFacesOfElement_5.Surface)
byJoinedSurfaces_4 = PolySurface.ByJoinedSurfaces(surfaces=flatten_38)
doesIntersect_10 = Geometry.DoesIntersect(geometry=byJoinedSurfaces_4, other=flatten_37, lacing=CrossProduct)
filterByBoolMask_18 = List.FilterByBoolMask(list=flatten_37, mask=doesIntersect_10@L2)
flatten_39 = List.Flatten(list=filterByBoolMask_18.out)
area_11 = Surface.Area(surface=flatten_39)
sum_6 = Math.Sum(values=area_11)
code_block_96 = CodeBlock(i=sum_6) { Math.Round(List.Flatten(i)/1000000, 2); }
code_block_97 = CodeBlock { "M2"; }
count_17 = List.Count(list=code_block_96)
ofRepeatedItem_12 = List.OfRepeatedItem(item=code_block_97, amount=count_17)
code_block_98 = CodeBlock(FuncValues=code_block_96, FuncValuesUnit=ofRepeatedItem_12)  # same code as code_block_11

watch_47 = Watch(code_block_98)

# group: <Func 3> 콘크리트 체적 선택
code_block_99 = CodeBlock { "TargetElements"; }
valueAtKey_14 = DesignScript.Builtin.Dictionary.ValueAtKey(key=code_block_99)  # unwired: dictionary
# note: <Func>
geometry_6 = Element.Geometry(element=valueAtKey_14)
flatten_40 = List.Flatten(list=geometry_6@L2)
volume_3 = Solid.Volume(solid=flatten_40)
flatten_41 = List.Flatten(list=volume_3)
sum_7 = Math.Sum(values=flatten_41)
# note: 비율 추가
code_block_100 = CodeBlock(i=sum_7) { Math.Round(List.Flatten(i)/1000000000, 2); }
code_block_101 = CodeBlock { "M3"; }
count_18 = List.Count(list=code_block_100)
ofRepeatedItem_13 = List.OfRepeatedItem(item=code_block_101, amount=count_18)
code_block_102 = CodeBlock(FuncValues=code_block_100, FuncValuesUnit=ofRepeatedItem_13)  # same code as code_block_11

watch_48 = Watch(code_block_102)
watch_49 = Watch(filterByBoolMask_17.out)
code_block_103 = CodeBlock { 1200; }
translate_2 = Geometry.Translate(geometry=byPoints_7, zTranslation=code_block_103)
list_create_4 = List.Create(item0=byPoints_7, item1=translate_2)
transpose_4 = List.Transpose(lists=list_create_4)
byLoft_2 = Surface.ByLoft(crossSections=transpose_4)
code_block_104 = CodeBlock { 300; }
thicken = Surface.Thicken(surface=byLoft_2, thickness=code_block_104)
doesIntersect_11 = Geometry.DoesIntersect(geometry=watch_49@L2, other=thicken@L1)
filterByBoolMask_19 = List.FilterByBoolMask(list=watch_49, mask=doesIntersect_11)
flatten_42 = List.Flatten(list=filterByBoolMask_19.out)
sort_3 = List.Sort(list=Z_2)
byStartPointEndPoint_4 = Line.ByStartPointEndPoint()  # unwired: startPoint, endPoint
code_block_105 = CodeBlock {  }

# group: Primary Input
categories_3 = Categories("OST_EdgeSlab")
all_elements_of_category_3 = ElementsOfCategory(Category=categories_3)
file_path_3 = Filename(".\BIM_물량집계 자동화 산출기준표_rC(20210729).xlsx")
file_from_path_2 = FileObject(path=file_path_3)
code_block_106 = CodeBlock { "Slab Edges"; }

# group: GetFull WMCodeDescription PerElement
getFullWMCodeDescriptionPerElement = Custom[GetFullWMCodeDescriptionPerElement](InputElement=all_elements_of_category_3, InputFilePath=file_from_path_2, InputSheetName=code_block_106)  # GetFullWMCodeDescriptionPerElement

# group: OrganizeAllElementInformAsDictionary
organizeAllElementInformAsDictionary_2 = Custom[OrganizeAllElementInformAsDictionary](InputDic=getFullWMCodeDescriptionPerElement.Dictionary)

# group: Select Target Family Element And Connected WorkMasters
code_block_107 = CodeBlock { 0; }
selectTargetFamilyInformAsDictionary_2 = Custom[SelectTargetFamilyInformAsDictionary](InputDic=organizeAllElementInformAsDictionary_2, InputIndex=code_block_107)

watch_50 = Watch(selectTargetFamilyInformAsDictionary_2)
code_block_108 = CodeBlock(i=watch_50) { i; }

# group: <Func 2> 측면 면적산출
code_block_109 = CodeBlock { "TargetElements"; }
valueAtKey_15 = DesignScript.Builtin.Dictionary.ValueAtKey(dictionary=code_block_108, key=code_block_109)
# note: <Func>
geometry_7 = Element.Geometry(element=valueAtKey_15@L1)
extractSideFacesOfElement_2 = Custom[ExtractSideFacesOfElement](Element=valueAtKey_15)

watch_51 = Watch(geometry_7)
flatten_43 = List.Flatten(list=watch_51)
explode_9 = Geometry.Explode(geometry=flatten_43)
code_block_110 = CodeBlock { 150000; }
area_12 = Surface.Area(surface=explode_9)
round_7 = Math.Round(number=area_12)
gt_6 = code_block_110 > round_7
filterByBoolMask_20 = List.FilterByBoolMask(list=explode_9, mask=gt_6)
watch_52 = Watch(filterByBoolMask_20.in)
perimeterCurves_8 = Surface.PerimeterCurves(surface=watch_52)
code_block_111 = CodeBlock { 0.5; }
pointAtParameter_5 = Surface.PointAtParameter(surface=watch_52, u=code_block_111, v=code_block_111)
startPoint_10 = Curve.StartPoint(curve=perimeterCurves_8)
byStartPointEndPoint_5 = Line.ByStartPointEndPoint(startPoint=pointAtParameter_5, endPoint=startPoint_10)
length_6 = Curve.Length()  # unwired: curve
minimumItemByKey_5 = List.MinimumItemByKey(list=byStartPointEndPoint_5@L2, keyFunction=length_6)
count_19 = List.Count(list=byStartPointEndPoint_5)
chop_5 = List.Chop(list=minimumItemByKey_5, lengths=count_19)
doesIntersect_12 = Geometry.DoesIntersect(geometry=chop_5@L2, other=perimeterCurves_8@L3)
filterByBoolMask_21 = List.FilterByBoolMask(list=perimeterCurves_8@L3, mask=doesIntersect_12@L3)
flatten_44 = List.Flatten(list=filterByBoolMask_21.in)
flatten_45 = List.Flatten(list=filterByBoolMask_20.in)
uniqueItems_6 = List.UniqueItems(list=round_7)
watch_53 = Watch(extractSideFacesOfElement_2.Surface)
watch_54 = Watch(watch_53)
code_block_112 = CodeBlock { 1; }
flatten_46 = List.Flatten(list=watch_54, amount=code_block_112)
code_block_113 = CodeBlock(a=flatten_46) { a[1]; }
watch_55 = Watch(filterByBoolMask_21.in)
watch_56 = Watch(watch_55)

# group: 프로파일 선택
watch_57 = Watch(watch_56)
code_block_114 = CodeBlock { 1; }
dropItems_7 = List.DropItems(list=watch_57@L3, amount=code_block_114)

byJoinedCurves_3 = PolyCurve.ByJoinedCurves(curves=dropItems_7)
watch_58 = Watch(flatten_46)
perimeterCurves_9 = Surface.PerimeterCurves(surface=watch_58)
code_block_115 = CodeBlock { -1; }
flatten_47 = List.Flatten(list=perimeterCurves_9@L3, amount=code_block_115)
length_7 = Curve.Length(curve=flatten_47)
code_block_116 = CodeBlock { 600; }
gt_7 = length_7 > code_block_116
filterByBoolMask_22 = List.FilterByBoolMask(list=flatten_47, mask=gt_7)
watch_59 = Watch(filterByBoolMask_22.in)
extractUpperFacesOfElement_6 = Custom[ExtractUpperFacesOfElement](Element=valueAtKey_15)
watch_60 = Watch(extractUpperFacesOfElement_6.Surface)
flatten_48 = List.Flatten(list=watch_60)
byJoinedSurfaces_5 = PolySurface.ByJoinedSurfaces(surfaces=flatten_48)
doesIntersect_13 = Geometry.DoesIntersect(geometry=byJoinedSurfaces_5, other=watch_59, lacing=CrossProduct)
filterByBoolMask_23 = List.FilterByBoolMask(list=watch_59, mask=doesIntersect_13)
byJoinedCurves_4 = PolyCurve.ByJoinedCurves(curves=filterByBoolMask_23.in)
watch_61 = Watch(byJoinedCurves_4)
bySweep_3 = Surface.BySweep(profile=byJoinedCurves_3, path=watch_61)
code_block_117 = CodeBlock {  }
watch_62 = Watch(extractSideFacesOfElement_2.Surface)
watch_63 = Watch(watch_62)
code_block_118 = CodeBlock { 1; }
flatten_49 = List.Flatten(list=watch_63, amount=code_block_118)
code_block_119 = CodeBlock(a=flatten_49) { a[0]; }
explode_10 = Geometry.Explode(geometry=code_block_119)
perimeterCurves_10 = Surface.PerimeterCurves(surface=explode_10)
flatten_50 = List.Flatten(list=perimeterCurves_10)
length_8 = Curve.Length(curve=flatten_50)
uniqueItems_7 = List.UniqueItems(list=length_8)
watch_64 = Watch(uniqueItems_7)
sort_4 = List.Sort(list=watch_64)
watch_65 = Watch(sort_4)
code_block_120 = CodeBlock(a=geometry_7) { a[0]; }
explode_11 = Geometry.Explode(geometry=code_block_120)
area_13 = Surface.Area(surface=explode_11)
round_8 = Math.Round(number=area_13)
uniqueItems_8 = List.UniqueItems(list=round_8)
code_block_121 = CodeBlock { 150000; }
gt_8 = code_block_121 > round_8
filterByBoolMask_24 = List.FilterByBoolMask(list=explode_11, mask=gt_8)
flatten_51 = List.Flatten(list=filterByBoolMask_24.in)
perimeterCurves_11 = Surface.PerimeterCurves(surface=flatten_51)
code_block_122 = CodeBlock { 0.5; }
pointAtParameter_6 = Surface.PointAtParameter(surface=flatten_51, u=code_block_122, v=code_block_122)
startPoint_11 = Curve.StartPoint(curve=perimeterCurves_11)
byStartPointEndPoint_6 = Line.ByStartPointEndPoint(startPoint=pointAtParameter_6, endPoint=startPoint_11)
length_9 = Curve.Length()  # unwired: curve
minimumItemByKey_6 = List.MinimumItemByKey(list=byStartPointEndPoint_6@L2, keyFunction=length_9)
doesIntersect_14 = Geometry.DoesIntersect(geometry=minimumItemByKey_6, other=perimeterCurves_11)
filterByBoolMask_25 = List.FilterByBoolMask(list=perimeterCurves_11, mask=doesIntersect_14)
flatten_52 = List.Flatten(list=filterByBoolMask_25.in)
watch_66 = Watch(flatten_52)
code_block_123 = CodeBlock { 2; }
dropItems_8 = List.DropItems(list=watch_66, amount=code_block_123)
endPoint_5 = Curve.EndPoint(curve=dropItems_8)
code_block_124 = CodeBlock { -1; }
dropItems_9 = List.DropItems(list=endPoint_5, amount=code_block_124)
startPoint_12 = Curve.StartPoint(curve=dropItems_8)
join_7 = List.Join(list0=dropItems_9, list1=startPoint_12)
byPoints_8 = PolyCurve.ByPoints(points=join_7)
code_block_125 = CodeBlock { 600; }
gt_9 = length_8 > code_block_125
filterByBoolMask_26 = List.FilterByBoolMask(list=flatten_50, mask=gt_9)
flatten_53 = List.Flatten(list=filterByBoolMask_26.in)
watch_67 = Watch(extractUpperFacesOfElement_6.Surface)
flatten_54 = List.Flatten(list=watch_67)
byJoinedSurfaces_6 = PolySurface.ByJoinedSurfaces(surfaces=flatten_54)
doesIntersect_15 = Geometry.DoesIntersect(geometry=byJoinedSurfaces_6, other=flatten_53, lacing=CrossProduct)
filterByBoolMask_27 = List.FilterByBoolMask(list=flatten_53, mask=doesIntersect_15@L2)
flatten_55 = List.Flatten(list=filterByBoolMask_27.in)
byJoinedCurves_5 = PolyCurve.ByJoinedCurves(curves=flatten_55)
bySweep_4 = Surface.BySweep(profile=byPoints_8, path=byJoinedCurves_5)
watch_68 = Watch(extractSideFacesOfElement_2.Surface)
watch_69 = Watch(watch_68)
code_block_126 = CodeBlock { 1; }
flatten_56 = List.Flatten(list=watch_69, amount=code_block_126)
code_block_127 = CodeBlock(a=flatten_56) { a[1]; }
explode_12 = Geometry.Explode(geometry=code_block_127)
perimeterCurves_12 = Surface.PerimeterCurves(surface=explode_12)
flatten_57 = List.Flatten(list=perimeterCurves_12)
length_10 = Curve.Length(curve=flatten_57)
uniqueItems_9 = List.UniqueItems(list=length_10)
watch_70 = Watch(uniqueItems_9)
sort_5 = List.Sort(list=watch_70)
watch_71 = Watch(sort_5)
code_block_128 = CodeBlock(a=geometry_7) { a[1]; }
explode_13 = Geometry.Explode(geometry=code_block_128)
code_block_129 = CodeBlock { 150000; }
area_14 = Surface.Area(surface=explode_13)
round_9 = Math.Round(number=area_14)
gt_10 = code_block_129 > round_9
filterByBoolMask_28 = List.FilterByBoolMask(list=explode_13, mask=gt_10)
flatten_58 = List.Flatten(list=filterByBoolMask_28.in)
perimeterCurves_13 = Surface.PerimeterCurves(surface=flatten_58)
code_block_130 = CodeBlock { 0.5; }
pointAtParameter_7 = Surface.PointAtParameter(surface=flatten_58, u=code_block_130, v=code_block_130)
startPoint_13 = Curve.StartPoint(curve=perimeterCurves_13)
byStartPointEndPoint_7 = Line.ByStartPointEndPoint(startPoint=pointAtParameter_7, endPoint=startPoint_13)
length_11 = Curve.Length()  # unwired: curve
minimumItemByKey_7 = List.MinimumItemByKey(list=byStartPointEndPoint_7@L2, keyFunction=length_11)
doesIntersect_16 = Geometry.DoesIntersect(geometry=minimumItemByKey_7, other=perimeterCurves_13)
filterByBoolMask_29 = List.FilterByBoolMask(list=perimeterCurves_13, mask=doesIntersect_16)
flatten_59 = List.Flatten(list=filterByBoolMask_29.in)
watch_72 = Watch(flatten_59)
count_20 = List.Count(list=watch_72)
code_block_131 = CodeBlock(a=count_20) { (2-a); }
dropItems_10 = List.DropItems(list=watch_72, amount=code_block_131)
endPoint_6 = Curve.EndPoint(curve=dropItems_10)
code_block_132 = CodeBlock { -1; }
dropItems_11 = List.DropItems(list=endPoint_6, amount=code_block_132)
startPoint_14 = Curve.StartPoint(curve=dropItems_10)
join_8 = List.Join(list0=dropItems_11, list1=startPoint_14)
byPoints_9 = PolyCurve.ByPoints(points=join_8)
code_block_133 = CodeBlock { 600; }
gt_11 = length_10 > code_block_133
filterByBoolMask_30 = List.FilterByBoolMask(list=flatten_57, mask=gt_11)
flatten_60 = List.Flatten(list=filterByBoolMask_30.in)
watch_73 = Watch(extractUpperFacesOfElement_6.Surface)
flatten_61 = List.Flatten(list=watch_73)
byJoinedSurfaces_7 = PolySurface.ByJoinedSurfaces(surfaces=flatten_61)
doesIntersect_17 = Geometry.DoesIntersect(geometry=byJoinedSurfaces_7, other=flatten_60, lacing=CrossProduct)
filterByBoolMask_31 = List.FilterByBoolMask(list=flatten_60, mask=doesIntersect_17@L2)
flatten_62 = List.Flatten(list=filterByBoolMask_31.in)
byJoinedCurves_6 = PolyCurve.ByJoinedCurves(curves=flatten_62)
bySweep_5 = Surface.BySweep(profile=byPoints_9, path=byJoinedCurves_6)
uniqueItems_10 = List.UniqueItems(list=round_9)

# group: 사선 + 하부 모델링 업데이트 및 확정 후 재 확인
code_block_134 = CodeBlock {  }
code_block_135 = CodeBlock {  }

code_block_136 = CodeBlock {  }
code_block_137 = CodeBlock {  }

# group: Primary Input : Excel & Revit Elements
categories_4 = Categories("OST_EdgeSlab")
all_elements_of_category_4 = ElementsOfCategory(Category=categories_4)
string_from_web_2 = Python()  # CPython3; unwired: IN[0]; same code as string_from_web
file_path_4 = Filename(".\BIM_물량집계 자동화 산출기준표_rC(20211207)_강한호 (1).xlsx")  # graph input
sheet_name_2 = CodeBlock { "Slab Edges"; }
github_python_import_excel_by_2 = PythonStringNode(script=string_from_web_2, IN[0]=file_path_4, IN[1]=sheet_name_2)  # "Github_Python@Import Excel(By OpenpyXl)"; CPython3
code_block_138 = CodeBlock(InputElement=all_elements_of_category_4, InputData=github_python_import_excel_by_2) { _InputElement; _InputData; }

# group: GetFull WMCodeDescription PerElement
excelDataManagerNode_3 = Python(IN[0]=code_block_138._InputElement, IN[1]=code_block_138._InputData)  # CPython3; same code as excelDataManagerNode_2

# group: OrganizeAllElementInformAsDictionary
organizeAllElementInformAsDictionary_3 = Custom[OrganizeAllElementInformAsDictionary](InputDic=excelDataManagerNode_3)

# group: Select Target Family Element And Connected WorkMasters
code_block_139 = CodeBlock { 0; }
selectTargetFamilyInformAsDictionary_3 = Custom[SelectTargetFamilyInformAsDictionary](InputDic=organizeAllElementInformAsDictionary_3, InputIndex=code_block_139)

watch_74 = Watch(selectTargetFamilyInformAsDictionary_3)
code_block_140 = CodeBlock { i; }  # unwired: i

# group: Input Manager
value_for_import_from_others_2 = CodeBlock(MainInput=code_block_140) { MainInput; RefInput1; RefInput2; }  # unwired: RefInput1, RefInput2

# group: <Func 2> Excavation (SOG 한정)
levels = Levels("G.L")  # graph input
elevation = Level.Elevation(level=levels)
code_block_141 = CodeBlock { "TargetElements"; }
valueAtKey_16 = DesignScript.Builtin.Dictionary.ValueAtKey(dictionary=value_for_import_from_others_2.MainInput, key=code_block_141)
code_block_142 = CodeBlock { "Elevation at Bottom"; }
getParameterValueByName = Element.GetParameterValueByName(element=valueAtKey_16, parameterName=code_block_142)
린_콘크리트_하부까지의_길이_추출_최하단 = Python(IN[0]=value_for_import_from_others_2.RefInput1)  # CPython3
# ---------- 린_콘크리트_하부까지의_길이_추출_최하단.python (22 lines) ----------
# Load the Python Standard and DesignScript Libraries
import sys
import clr
clr.AddReference('ProtoGeometry')
from Autodesk.DesignScript.Geometry import *

# The inputs to this node will be stored as a list in the IN variables.
dataEnteringNode = IN
inputs = IN[0]

# Place your code below this line

def findThickness(i):
    minPt_Z = BoundingBox.ByGeometry(i).MinPoint.Z
    maxPt_Z = BoundingBox.ByGeometry(i).MaxPoint.Z
    result = maxPt_Z - minPt_Z
    return result

thicknessByInput = list(map(findThickness, inputs))

# Assign your output to the OUT variable.
OUT = thicknessByInput
# ----------------------------------------
code_block_143 = CodeBlock(기초하단=getParameterValueByName, 린콘크리트하단=린_콘크리트_하부까지의_길이_추출_최하단) { 기초하단-린콘크리트하단; }
sub = elevation - code_block_143
code_block_144 = CodeBlock(i=sub) { i<0?true:false; }
code_block_145 = CodeBlock { 0; }
flatten_63 = List.Flatten(list=value_for_import_from_others_2.RefInput1)
하부_surface_추출 = Python(IN[0]=flatten_63)  # CPython3
# ---------- 하부_surface_추출.python (26 lines) ----------
# Load the Python Standard and DesignScript Libraries
import sys
import clr
import itertools
clr.AddReference('ProtoGeometry')
from Autodesk.DesignScript.Geometry import *

# The inputs to this node will be stored as a list in the IN variables.
dataEnteringNode = IN
input_elements = IN[0]

# Place your code below this line

srfs_input_elements = list(map(lambda x: x.Explode(), input_elements))

#srfs_input_flatten = list(itertools.chain(*srfs_input_elements))

def func_findZ_normalAtParma(srf):
    return srf.NormalAtParameter(0.5,0.5).Z
srfs_below = list(map(lambda y: filter(lambda x: func_findZ_normalAtParma(x) == -1, y), srfs_input_elements))

result = srfs_below


# Assign your output to the OUT variable.
OUT = result
# ----------------------------------------
flatten_64 = List.Flatten(list=하부_surface_추출)
perimeterCurves_14 = Surface.PerimeterCurves(surface=flatten_64)
byJoinedCurves_7 = PolyCurve.ByJoinedCurves(curves=perimeterCurves_14)
code_block_146 = CodeBlock { _ExcavOffsetBottom: var[]..[] = 300; }
offset = Curve.Offset(curve=byJoinedCurves_7, distance=code_block_146)
flatten_65 = List.Flatten(list=offset)
flatten_66 = List.Flatten(list=sub)
translate_3 = Geometry.Translate(geometry=offset, zTranslation=flatten_66)
경사_비율_입력_1_x_for_isofdn = DoubleInput(2)  # graph input
code_block_147 = CodeBlock(ElevationatBottom=flatten_66, 비율=경사_비율_입력_1_x_for_isofdn) { ElevationatBottom/비율; }
offset_2 = Curve.Offset(curve=translate_3, distance=code_block_147)
flatten_67 = List.Flatten(list=offset_2)
list_create_5 = List.Create(item0=flatten_65, item1=flatten_67)
transpose_5 = List.Transpose(lists=list_create_5)
byLoft_3 = Solid.ByLoft(crossSections=transpose_5)
터파기_형상_겹침_해소 = Python(IN[0]=byLoft_3)  # CPython3
# ---------- 터파기_형상_겹침_해소.python (29 lines) ----------
# Load the Python Standard and DesignScript Libraries
import sys
import clr
clr.AddReference('ProtoGeometry')
from Autodesk.DesignScript.Geometry import *

# The inputs to this node will be stored as a list in the IN variables.
dataEnteringNode = IN
inputs = IN[0]
result = []
# Place your code below this line

for x in range(len(inputs)):
    if x < len(inputs)-1:
        temp = []
        apply = inputs[x]
        for y in range(x,len(inputs)):
            if apply.DoesIntersect(inputs[y]):
                apply = apply.Split(inputs[y])[0]
                temp.append(apply)
            else:
                apply = apply
                temp.append(apply)
        result.append(temp[-1])
    elif x == len(inputs)-1:
        result.append(inputs[x])

# Assign your output to the OUT variable.
OUT = result
# ----------------------------------------
volume_4 = Solid.Volume(solid=터파기_형상_겹침_해소)
code_block_148 = CodeBlock(i=volume_4) { Math.Round(List.Flatten(i)/1000000000, 2); }
if_4 = If(test=code_block_144, true=code_block_145, false=code_block_148)
code_block_149 = CodeBlock { "M3"; }
count_21 = List.Count(list=code_block_148)
ofRepeatedItem_14 = List.OfRepeatedItem(item=code_block_149, amount=count_21)
code_block_150 = CodeBlock(FuncValues=if_4, FuncValuesUnit=ofRepeatedItem_14)  # same code as code_block_11
color_palette_2 = ColorPalette({R: 210, G: 105, B: 30, A: 135})
byGeometryColor_2 = Modifiers.GeometryColor.ByGeometryColor(geometry=터파기_형상_겹침_해소, color=color_palette_2)
forRefOutput = CodeBlock(MainOutput=code_block_150, geoColor=byGeometryColor_2, 터파기형상=터파기_형상_겹침_해소)
# ---------- forRefOutput.designscript (5 lines) ----------
{
"MainOutput": MainOutput,
"geoColor": geoColor,
"터파기형상": 터파기형상
};
# ----------------------------------------

# group: Output Manager
output_2 = CodeBlock(MainOutput=forRefOutput, RefOutput_geoColor=byGeometryColor_2) { MainOutput; RefOutput_geoColor; }
reference_output_2 = CodeBlock(ref=터파기_형상_겹침_해소, ref2=if_4) { ref; ref2; }

# group: Visual Manager
visual_켜기_끄기_2 = BoolSelector(false)
visual_manager_2 = Python(IN[0]=output_2.RefOutput_geoColor, IN[1]=visual_켜기_끄기_2)  # CPython3; same code as visual_manager

# group: Input Manager
value_for_import_from_others_3 = CodeBlock(MainInput=code_block_140) { MainInput; RefInput1; RefInput2; }  # unwired: RefInput1, RefInput2

# group: <Func 1> Structural Concrete
code_block_151 = CodeBlock { "TargetElements"; }
valueAtKey_17 = DesignScript.Builtin.Dictionary.ValueAtKey(dictionary=value_for_import_from_others_3.MainInput, key=code_block_151)
# note: <Func>
geometry_8 = Element.Geometry(element=valueAtKey_17)
volume_5 = Solid.Volume(solid=geometry_8)
code_block_152 = CodeBlock(i=volume_5) { Math.Round(List.Flatten(i)/1000000000,2); }
code_block_153 = CodeBlock { "M3"; }
count_22 = List.Count(list=code_block_152)
ofRepeatedItem_15 = List.OfRepeatedItem(item=code_block_153, amount=count_22)
code_block_154 = CodeBlock(FuncValues=code_block_152, FuncValuesUnit=ofRepeatedItem_15)  # same code as code_block_11

# group: Output Manager
reference_output_3 = CodeBlock(ref=geometry_8) { ref; }
output_3 = CodeBlock(MainOutput=code_block_154) { MainOutput; RefOutput_geoColor; }  # unwired: RefOutput_geoColor

# group: Input Manager
value_for_import_from_others_4 = CodeBlock(MainInput=code_block_140, RefInput2=reference_output_2.ref, RefInput3=reference_output_3) { MainInput; RefInput1; RefInput2; RefInput3; }  # unwired: RefInput1

# group: <Func 3> Backfill
value_for_import_from_others_5 = CodeBlock(터파기형상=value_for_import_from_others_4.RefInput2) { 터파기형상; }
flatten_68 = List.Flatten(list=value_for_import_from_others_5)
volume_6 = Solid.Volume(solid=flatten_68)
watch_75 = Watch(volume_6)
code_block_155 = CodeBlock(i=watch_75) { Math.Round(List.Flatten(i)/1000000000, 2); }
code_block_156 = CodeBlock { "M3"; }
count_23 = List.Count(list=watch_75)
ofRepeatedItem_16 = List.OfRepeatedItem(item=code_block_156, amount=count_23)
# note: 터파기 물량ㅈ에서 콘크리트, 린 기둥 물량 빼기
code_block_157 = CodeBlock(FuncValues=code_block_155, FuncValuesUnit=ofRepeatedItem_16)  # same code as code_block_11
value_for_import_from_others_6 = CodeBlock(슬라브형상=value_for_import_from_others_4.RefInput3) { 슬라브형상; }
flatten_69 = List.Flatten(list=value_for_import_from_others_6)
doesIntersect_18 = Geometry.DoesIntersect(geometry=flatten_68, other=flatten_69, lacing=CrossProduct)
filterByBoolMask_32 = List.FilterByBoolMask(list=flatten_69, mask=doesIntersect_18@L2)
flatten_70 = List.Flatten(list=filterByBoolMask_32.in)

# group: Output Manager
output_4 = CodeBlock(MainOutput=code_block_157) { MainOutput; RefOutput_geoColor; }  # unwired: RefOutput_geoColor
reference_output_4 = CodeBlock { ref; }  # unwired: ref

# group: Input Manager
value_for_import_from_others_7 = CodeBlock(MainInput=code_block_140, RefInput1=reference_output_2.ref2) { MainInput; RefInput1; RefInput2; }  # unwired: RefInput2

# group: <Func 4>Disposal
code_block_158 = CodeBlock(i=value_for_import_from_others_7.RefInput1) { i==0?true:false; }
code_block_159 = CodeBlock { 0; }
# note: <Func>
if_5 = If(test=code_block_158, true=code_block_159, false=value_for_import_from_others_7.RefInput1)
code_block_160 = CodeBlock(i=if_5) { Math.Round(List.Flatten(i)/1000000000, 2); }
code_block_161 = CodeBlock { "M3"; }
count_24 = List.Count(list=code_block_160)
ofRepeatedItem_17 = List.OfRepeatedItem(item=code_block_161, amount=count_24)
code_block_162 = CodeBlock(FuncValues=code_block_160, FuncValuesUnit=ofRepeatedItem_17)  # same code as code_block_11
code_block_163 = CodeBlock { "TargetElements"; }
valueAtKey_18 = DesignScript.Builtin.Dictionary.ValueAtKey(dictionary=value_for_import_from_others_7.MainInput, key=code_block_163)
count_25 = List.Count(list=valueAtKey_18@L1)

# group: Output Manager
output_5 = CodeBlock(MainOutput=code_block_162) { MainOutput; RefOutput_geoColor; }  # unwired: RefOutput_geoColor
reference_output_5 = CodeBlock { ref; }  # unwired: ref

# group: Input Manager
value_for_import_from_others_8 = CodeBlock(MainInput=code_block_140) { MainInput; RefInput1; RefInput2; }  # unwired: RefInput1, RefInput2

# group: <Func 7>Rebar Work
code_block_164 = CodeBlock { "TargetElements"; }
valueAtKey_19 = DesignScript.Builtin.Dictionary.ValueAtKey(dictionary=value_for_import_from_others_8.MainInput, key=code_block_164)
code_block_165 = CodeBlock { "Volume"; }
# note: <Func>
getParameterValueByName_2 = Element.GetParameterValueByName(element=valueAtKey_19, parameterName=code_block_165)
sog_철근비 = DoubleInput(0)  # graph input
mul = getParameterValueByName_2 * sog_철근비
code_block_166 = CodeBlock(i=mul) { Math.Round(List.Flatten(i)/1, 2); }
code_block_167 = CodeBlock { "TON"; }
count_26 = List.Count(list=code_block_166)
ofRepeatedItem_18 = List.OfRepeatedItem(item=code_block_167, amount=count_26)
code_block_168 = CodeBlock(FuncValues=code_block_166, FuncValuesUnit=ofRepeatedItem_18)  # same code as code_block_11

# group: Output Manager
output_6 = CodeBlock(MainOutput=code_block_168) { MainOutput; RefOutput_geoColor; }  # unwired: RefOutput_geoColor
reference_output_6 = CodeBlock { ref; }  # unwired: ref

watch_76 = Watch(output_2.MainOutput)

# group: Input Manager
value_for_import_from_others_9 = CodeBlock(MainInput=code_block_140) { MainInput; RefInput1; RefInput2; }  # unwired: RefInput1, RefInput2

# group: <Func 6> Form Works (Ground Slab 거푸집 필요X)
code_block_169 = CodeBlock { "TargetElements"; }
valueAtKey_20 = DesignScript.Builtin.Dictionary.ValueAtKey(dictionary=value_for_import_from_others_9.MainInput, key=code_block_169)
code_block_170 = CodeBlock { "Volume"; }
# note: <Func>
getParameterValueByName_3 = Element.GetParameterValueByName(element=valueAtKey_20, parameterName=code_block_170)
code_block_171 = CodeBlock(i=getParameterValueByName_3) { Math.Round(List.Flatten(i)/10000000,2); }
code_block_172 = CodeBlock { "M3"; }
count_27 = List.Count(list=code_block_171)
ofRepeatedItem_19 = List.OfRepeatedItem(item=code_block_172, amount=count_27)
code_block_173 = CodeBlock(FuncValues=code_block_171, FuncValuesUnit=ofRepeatedItem_19)  # same code as code_block_11

# group: Output Manager
reference_output_7 = CodeBlock { ref; }  # unwired: ref
output_7 = CodeBlock(MainOutput=code_block_173) { MainOutput; RefOutput_geoColor; }  # unwired: RefOutput_geoColor

# group: Input Manager
value_for_import_from_others_10 = CodeBlock(MainInput=code_block_140) { MainInput; RefInput1; RefInput2; }  # unwired: RefInput1, RefInput2

# group: <Func 5> Structural Concrete
code_block_174 = CodeBlock { "TargetElements"; }
valueAtKey_21 = DesignScript.Builtin.Dictionary.ValueAtKey(dictionary=value_for_import_from_others_10.MainInput, key=code_block_174)
# note: <Func>
geometry_9 = Element.Geometry(element=valueAtKey_21)
volume_7 = Solid.Volume(solid=geometry_9)
code_block_175 = CodeBlock(i=volume_7) { Math.Round(List.Flatten(i)/1000000000,2); }
code_block_176 = CodeBlock { "M3"; }
count_28 = List.Count(list=code_block_175)
ofRepeatedItem_20 = List.OfRepeatedItem(item=code_block_176, amount=count_28)
code_block_177 = CodeBlock(FuncValues=code_block_175, FuncValuesUnit=ofRepeatedItem_20)  # same code as code_block_11

# group: Output Manager
output_8 = CodeBlock(MainOutput=code_block_177) { MainOutput; RefOutput_geoColor; }  # unwired: RefOutput_geoColor
reference_output_8 = CodeBlock(ref=geometry_9) { ref; }
