# Dynamo graph 01 Floor (220110).dyn (Dynamo 2.12.0.5650)

# group: Output Manager
output = CodeBlock { MainOutput; RefOutput_geoColor; }  # unwired: MainOutput, RefOutput_geoColor
reference_output = CodeBlock { ref; }  # unwired: ref

# group: Visual Manager
visual_켜기_끄기 = BoolSelector(false)
visual_manager = Python(IN[0]=output.RefOutput_geoColor, IN[1]=visual_켜기_끄기)  # CPython3
# ---------- visual_manager.python (18 lines) ----------
# Load the Python Standard and DesignScript Libraries
import sys
import clr
clr.AddReference('ProtoGeometry')
from Autodesk.DesignScript.Geometry import *

# The inputs to this node will be stored as a list in the IN variables.
dataEnteringNode = IN
geoColors = IN[0]
blnForVisual = IN[1]

# Place your code below this line
if blnForVisual == True:
    result = geoColors
else:
    result = 0
# Assign your output to the OUT variable.
OUT = result
# ----------------------------------------

# group: Primary Input : Excel & Revit Elements
categories = Categories("OST_Floors")
all_elements_of_category = ElementsOfCategory(Category=categories)
string_from_web = Python()  # CPython3; unwired: IN[0]
# ---------- string_from_web.python (19 lines) ----------
# Load the Python Standard and DesignScript Libraries
import sys
import clr
clr.AddReference('ProtoGeometry')
from Autodesk.DesignScript.Geometry import *
import urllib.request

# The inputs to this node will be stored as a list in the IN variables.
dataEnteringNode = IN
inputURL = "https://raw.githubusercontent.com/HNANmal/mQ/master/Hdynlib/General/ImportExcel.py"

# Place your code below this line
req = urllib.request
data = req.urlopen(inputURL)

result = data.read().decode("utf-8")

# Assign your output to the OUT variable.
OUT = result
# ----------------------------------------
file_path = Filename(".\DMS(Data Matching Schedule)_R0(Seq.1)(2).xlsx")  # graph input
sheet_name = CodeBlock { "Floors"; }
github_python_import_excel_by = PythonStringNode(script=string_from_web, IN[0]=file_path, IN[1]=sheet_name)  # "Github_Python@Import Excel(By OpenpyXl)"; CPython3
code_block = CodeBlock(InputElement=all_elements_of_category, InputData=github_python_import_excel_by) { _InputElement; _InputData; }

# group: GetFull WMCodeDescription PerElement
excelDataManagerNode = Python(IN[0]=code_block._InputElement, IN[1]=code_block._InputData)  # CPython3
# ---------- excelDataManagerNode.python (279 lines) ----------
# Load the Python Standard and DesignScript Libraries
import os
import sys
sys.path.append(os.getenv('LOCALAPPDATA').replace('\\','\\\\') + r'\Programs\Python\Python39\Lib\site-packages')
import clr
clr.AddReference('RevitAPI')
import Autodesk

clr.AddReference('ProtoGeometry')
from Autodesk.DesignScript.Geometry import *

clr.AddReference('RevitNodes')
import Revit
clr.ImportExtensions(Revit.Elements)

clr.ImportExtensions(Revit.GeometryConversion)
clr.ImportExtensions(Revit.GeometryReferences)

clr.AddReference('RevitServices')
import RevitServices
from RevitServices.Persistence import DocumentManager
from RevitServices.Transactions import TransactionManager

doc = DocumentManager.Instance.CurrentDBDocument

import random
import itertools
from functools import reduce
from collections import Iterable
import datetime
import openpyxl

def iterable(obj):
    return isinstance(obj, Iterable)

def findUnique(inputs):
    result = []
    for i in inputs:
        if i in result:
            pass
        else:
            result.append(i)
    return result

# The inputs to this node will be stored as a list in the IN variables.
dataEnteringNode = IN
inputElements = IN[0]
inputData = IN[1]
#inputSheetName = IN[2]

def importExcel(path, SheetNameIn):
    wb_obj = openpyxl.load_workbook(str(path), data_only=True)
    sheet_obj = wb_obj.get_sheet_by_name(str(SheetNameIn))

    m_row = sheet_obj.max_row
    m_col = sheet_obj.max_column

    listOut = []

    for i in range(1, m_row +1):
        listTemp = []
        for j in range(1, m_col + 1):
            cell_obj = sheet_obj.cell(row=i, column=j)
            listTemp.append(cell_obj.value)
            if len(listTemp) == m_col:
                listOut.append(listTemp)
    return listOut

def getUsedFamilyTypeOfModeling(elements):
    familyCode = list(map(lambda x: x.Name.split('_')[0], elements))
    unq_familyCode = findUnique(familyCode)
    return unq_familyCode
    
def createExcelDataDictionary(values):
    result = {}
    for i in range(len(values)):
        result[str(i)] = values[i]
    return result

def findTargetIndex(targets, list):
    result = []
    for target in targets:
        for i in range(len(list)):
            if target in str(list[i]):
                result.append(i)
            else:
                pass
    result.sort()
    return result
    
def GetValueAtKeys(keys, dictionary):
    result = [] 
    for i in keys:
        result.append(dictionary[str(i)])
    return result


# Place your code below this line
usedFamilyTypeOfModeling = getUsedFamilyTypeOfModeling(inputElements)
excelWholeDataSet = inputData#importExcel(inputFilePath, inputSheetName)
trExcelWholeDataSet = list(zip(*excelWholeDataSet))
excelColumnDataSet = createExcelDataDictionary(trExcelWholeDataSet)
excelRowDataSet = createExcelDataDictionary(excelWholeDataSet)
ColumnIndexOfUsedFamilyType = findTargetIndex(usedFamilyTypeOfModeling, trExcelWholeDataSet)
ColDataSetOfUsedFamilyType = GetValueAtKeys(ColumnIndexOfUsedFamilyType, excelColumnDataSet)
materialPerElementFromModeling = []
for i in inputElements:
    materialPerElementFromModeling.append(i.GetMaterials())
#list(map(lambda x: x.GetMaterials, inputElements)) "맵함수로 처리하면 리스트화 할 때 타입 변환 오류 남"

targetWMRowIndex = []
for i in ColDataSetOfUsedFamilyType:
    targetWMRowIndex.append(findTargetIndex(['000'], i))

rowDataSetOfUsedWM = []
for i in targetWMRowIndex:
    rowDataSetOfUsedWM.append(GetValueAtKeys(i, excelRowDataSet))

workGroup = []
for i in rowDataSetOfUsedWM:
    tmp = []
    for j in i:
        tmp.append(j[0])
    workGroup.append(tmp)
    
workMaster = []
for i in range(len(ColDataSetOfUsedFamilyType)):
    tmp=[]
    for k in targetWMRowIndex[i]:
        tmp.append(ColDataSetOfUsedFamilyType[i][k])
    workMaster.append(tmp)

matchedWM = []
for i in range(len(workGroup)):
    tmp = []
    for j in range(len(workGroup[i])):
        fullWM = workGroup[i][j] +"-"+ workMaster[i][j]
        tmp.append(fullWM)
    matchedWM.append(tmp)

matchedWorkGruopAndMasterCode = []
for i in matchedWM:
    if len(i) > 0:
        matchedWorkGruopAndMasterCode.append(i)
    else:
        pass

matchedWMDescription = []
for i in rowDataSetOfUsedWM:
    tmp=[]
    for j in i:
        tmp.append(j[1] +" "+ j[2] +" "+ j[3] +" "+ "("+ j[4] +")")
    if len(tmp) > 0:
        matchedWMDescription.append(tmp)
    else:
        pass

matchedWMUnit = []
for i in rowDataSetOfUsedWM:
    tmp=[]
    for j in i:
        tmp.append(j[4])
    if len(tmp) > 0:
        matchedWMUnit.append(tmp)
    else:
        pass

matchedWorkGruopAndMasterCode_flat = list(itertools.chain(*matchedWorkGruopAndMasterCode))
matchedWMDescription_flat = list(itertools.chain(*matchedWMDescription))

dic_WMandDescription_Excel = {}
for i in range(len(matchedWorkGruopAndMasterCode_flat)):
    dic_WMandDescription_Excel[matchedWorkGruopAndMasterCode_flat[i]] = matchedWMDescription_flat[i]

usedFamilyTypeInExcelOrder = list(map(lambda x: x[3], ColDataSetOfUsedFamilyType))
usedFamilyCodeInExcelOrder = findUnique(list(map(lambda x: x.split('_')[0], usedFamilyTypeInExcelOrder)))

dic_FamilyCodeandWM = {}
for i in range(len(usedFamilyCodeInExcelOrder)):
    dic_FamilyCodeandWM[usedFamilyCodeInExcelOrder[i]] = matchedWorkGruopAndMasterCode[i]

workMasterCodePerElement = []
familyCodePerElem = list(map(lambda x: x.Name.split('_')[0], inputElements))
for i in familyCodePerElem:
    workMasterCodePerElement.append(dic_FamilyCodeandWM[i])

materialNamePerElem = []
for i in materialPerElementFromModeling:
    tmp = []
    for j in i:
        tmp.append(j.Name)
    materialNamePerElem.append(tmp)

WMPerElementFromModeling = []
for i in materialNamePerElem:
    tmp = []
    for j in i:
        tmp.append(j.split('_')[0])
    WMPerElementFromModeling.append(tmp)

specPerElementFromModeling = []
for i in materialNamePerElem:
    tmp = []
    for j in i:
        a = j.split('_')
        del a[0]
        b = " ".join(a)
        tmp.append(b)
    specPerElementFromModeling.append(tmp)

WMPerElementFromModeling_flat = list(itertools.chain(*WMPerElementFromModeling))
specPerElementFromModeling_flat = list(itertools.chain(*specPerElementFromModeling))

dic_WMandDescription_Model = {}
for i in range(len(WMPerElementFromModeling_flat)):
    dic_WMandDescription_Model[WMPerElementFromModeling_flat[i]] = specPerElementFromModeling_flat[i]

def findAllKeys(dict):
    result = []
    for key in dict.keys():
        result.append(key)
    return result

def findAllValues(dict):
    result = []
    for key in dict.keys():
        result.append(dict[key])
    return result

keys_WMandDescription_Model = findAllKeys(dic_WMandDescription_Model)
keys_WMandDescription_Excel = findAllKeys(dic_WMandDescription_Excel)

keys_WMandDescription_Both = list(set(keys_WMandDescription_Model + keys_WMandDescription_Excel))
values_WMandDescription_Both = []
for i in keys_WMandDescription_Both:
    if i in keys_WMandDescription_Model:
        values_WMandDescription_Both.append(dic_WMandDescription_Model[i])
    else:
        values_WMandDescription_Both.append(dic_WMandDescription_Excel[i])

dic_WMandDescription_Both = {}
for i in range(len(keys_WMandDescription_Both)):
    dic_WMandDescription_Both[keys_WMandDescription_Both[i]] = values_WMandDescription_Both[i]

workMasterCodePerElementFromBoth = []
for i in range(len(workMasterCodePerElement)):
    #tmp = []
    a = WMPerElementFromModeling[i] + workMasterCodePerElement[i]
    b = findUnique(a)
    workMasterCodePerElementFromBoth.append(b)

specPerElement = []
for i in workMasterCodePerElementFromBoth:
    tmp = []
    for j in i:
        tmp.append(dic_WMandDescription_Both[j])
    specPerElement.append(tmp)

fullWMCodeDescriptionPerElement = []
for i in range(len(workMasterCodePerElementFromBoth)):
    tmp = []
    for j in range(len(workMasterCodePerElementFromBoth[i])):
        a = workMasterCodePerElementFromBoth[i][j] +": "+ specPerElement[i][j]
        tmp.append(a)
    fullWMCodeDescriptionPerElement.append(tmp)

fullWMinfo = {
"AllElement": inputElements,
"WorkMasterCodePerFamilyType": dic_FamilyCodeandWM,
"WorkMasterCodePerElementBoth": workMasterCodePerElementFromBoth,
"FullWMCodeDescriptionPerElement": fullWMCodeDescriptionPerElement
}



result = fullWMinfo

# Assign your output to the OUT variable.
OUT = result
# ----------------------------------------

# group: Organize AllElementInform AsDictionary
set_up_all_element_inform_as = Python(IN[0]=excelDataManagerNode)  # "Set Up All Element Inform as Dictionary"; CPython3
# ---------- set_up_all_element_inform_as.python (119 lines) ----------
# Load the Python Standard and DesignScript Libraries
import os
import sys
sys.path.append(os.getenv('LOCALAPPDATA').replace('\\','\\\\') + r'\Programs\Python\Python39\Lib\site-packages')
import clr
clr.AddReference('RevitAPI')
import Autodesk

clr.AddReference('ProtoGeometry')
from Autodesk.DesignScript.Geometry import *

clr.AddReference('RevitNodes')
import Revit
clr.ImportExtensions(Revit.Elements)

clr.ImportExtensions(Revit.GeometryConversion)
clr.ImportExtensions(Revit.GeometryReferences)

clr.AddReference('RevitServices')
import RevitServices
from RevitServices.Persistence import DocumentManager
from RevitServices.Transactions import TransactionManager

doc = DocumentManager.Instance.CurrentDBDocument

import random
import itertools
from functools import reduce
from collections import Iterable
import datetime
import openpyxl

def iterable(obj):
    return isinstance(obj, Iterable)

def findUnique(inputs):
    result = []
    for i in inputs:
        if i in result:
            pass
        else:
            result.append(i)
    return result

# The inputs to this node will be stored as a list in the IN variables.
dataEnteringNode = IN
inputDict = IN[0]


def importExcel(path, SheetNameIn):
    wb_obj = openpyxl.load_workbook(str(path), data_only=True)
    sheet_obj = wb_obj.get_sheet_by_name(str(SheetNameIn))

    m_row = sheet_obj.max_row
    m_col = sheet_obj.max_column

    listOut = []

    for i in range(1, m_row +1):
        listTemp = []
        for j in range(1, m_col + 1):
            cell_obj = sheet_obj.cell(row=i, column=j)
            listTemp.append(cell_obj.value)
            if len(listTemp) == m_col:
                listOut.append(listTemp)
    return listOut

def getUsedFamilyTypeOfModeling(elements):
    familyCode = list(map(lambda x: x.Name.split('_')[0], elements))
    unq_familyCode = findUnique(familyCode)
    return unq_familyCode
    
def createExcelDataDictionary(values):
    result = {}
    for i in range(len(values)):
        result[str(i)] = values[i]
    return result

def findTargetIndex(targets, list):
    result = []
    for target in targets:
        for i in range(len(list)):
            if target in str(list[i]):
                result.append(i)
            else:
                pass
    result.sort()
    return result
    
def GetValueAtKeys(keys, dictionary):
    result = [] 
    for i in keys:
        result.append(dictionary[str(i)])
    return result


# Place your code below this line
element = inputDict["AllElement"]
elementType = []
for i in element:
    elementType.append(i.Name)
familyCode = []
for i in elementType:
    familyCode.append(i.split("_")[0])
fullWMCodeDescriptionPerElement = inputDict["FullWMCodeDescriptionPerElement"]

resultDict = {
"Element": element,
"ElementType": elementType,
"FamilyCode": familyCode,
"FullWMCodeDescriptionPerElement": fullWMCodeDescriptionPerElement
}



result = resultDict

# Assign your output to the OUT variable.
OUT = result
# ----------------------------------------

# group: Select Target Family Element And Connected WorkMasters
code_block_2 = CodeBlock { 0; }
select_target_family_element_and = Python(IN[0]=set_up_all_element_inform_as, IN[1]=code_block_2)  # "Select Target Family Element And Connected WorkMasters"; CPython3
# ---------- select_target_family_element_and.python (138 lines) ----------
# Load the Python Standard and DesignScript Libraries
import os
import sys
sys.path.append(os.getenv('LOCALAPPDATA').replace('\\','\\\\') + r'\Programs\Python\Python39\Lib\site-packages')
import clr
clr.AddReference('RevitAPI')
import Autodesk

clr.AddReference('ProtoGeometry')
from Autodesk.DesignScript.Geometry import *

clr.AddReference('RevitNodes')
import Revit
clr.ImportExtensions(Revit.Elements)

clr.ImportExtensions(Revit.GeometryConversion)
clr.ImportExtensions(Revit.GeometryReferences)

clr.AddReference('RevitServices')
import RevitServices
from RevitServices.Persistence import DocumentManager
from RevitServices.Transactions import TransactionManager

doc = DocumentManager.Instance.CurrentDBDocument

import random
import itertools
from functools import reduce
from collections import Iterable
import datetime
import openpyxl

def iterable(obj):
    return isinstance(obj, Iterable)

def findUnique(inputs):
    result = []
    for i in inputs:
        if i in result:
            pass
        else:
            result.append(i)
    return result

# The inputs to this node will be stored as a list in the IN variables.
dataEnteringNode = IN
inputDict = IN[0]
inputIndex = IN[1]


def importExcel(path, SheetNameIn):
    wb_obj = openpyxl.load_workbook(str(path), data_only=True)
    sheet_obj = wb_obj.get_sheet_by_name(str(SheetNameIn))

    m_row = sheet_obj.max_row
    m_col = sheet_obj.max_column

    listOut = []

    for i in range(1, m_row +1):
        listTemp = []
        for j in range(1, m_col + 1):
            cell_obj = sheet_obj.cell(row=i, column=j)
            listTemp.append(cell_obj.value)
            if len(listTemp) == m_col:
                listOut.append(listTemp)
    return listOut

def getUsedFamilyTypeOfModeling(elements):
    familyCode = list(map(lambda x: x.Name.split('_')[0], elements))
    unq_familyCode = findUnique(familyCode)
    return unq_familyCode
    
def createExcelDataDictionary(values):
    result = {}
    for i in range(len(values)):
        result[str(i)] = values[i]
    return result

def findTargetIndex(targets, list):
    result = []
    for target in targets:
        for i in range(len(list)):
            if target in str(list[i]):
                result.append(i)
            else:
                pass
    result.sort()
    return result
    
def GetValueAtKeys(keys, dictionary):
    result = [] 
    for i in keys:
        result.append(dictionary[str(i)])
    return result


# Place your code below this line
fullWMCodeDescriptionPerElement = inputDict["FullWMCodeDescriptionPerElement"]
element = inputDict["Element"]
familyCode = inputDict["FamilyCode"]
familyCode_unique = findUnique(familyCode)
targetFamilyCode = familyCode_unique[inputIndex]
targetIndex = []
for i in range(len(familyCode)):
    if targetFamilyCode in familyCode[i]:
        targetIndex.append(i)
    else:
        pass

targetElements = []
for i in targetIndex:
    targetElements.append(element[i])

targetFamilyCode = []
for i in targetIndex:
    targetFamilyCode.append(element[i].Name)

WMforTargetElements = []
for i in targetIndex:
    WMforTargetElements.append(fullWMCodeDescriptionPerElement[i])

WMforTargetElements_flat = list(itertools.chain(*WMforTargetElements))
targetWMunique = findUnique(WMforTargetElements_flat)

resultDict = {
"TargetElements": targetElements,
"TargetFamilyCode": targetFamilyCode,
"WMforTargetElements": WMforTargetElements,
"TargetWMunique": targetWMunique
}



result = resultDict

# Assign your output to the OUT variable.
OUT = result
# ----------------------------------------

watch = Watch(select_target_family_element_and)

# group: Select Target Family Element And Connected WorkMasters
code_block_3 = CodeBlock { 1; }
select_target_family_element_and_2 = Python(IN[0]=set_up_all_element_inform_as, IN[1]=code_block_3)  # "Select Target Family Element And Connected WorkMasters"; CPython3; same code as select_target_family_element_and

watch_2 = Watch(select_target_family_element_and_2)

# group: Output Manager
output_2 = CodeBlock { MainOutput; RefOutput_geoColor; }  # unwired: MainOutput, RefOutput_geoColor
reference_output_2 = CodeBlock { ref; }  # unwired: ref

# group: Visual Manager
visual_켜기_끄기_2 = BoolSelector(false)
visual_manager_2 = Python(IN[0]=output_2.RefOutput_geoColor, IN[1]=visual_켜기_끄기_2)  # CPython3; same code as visual_manager

# group: Output Manager
output_3 = CodeBlock { MainOutput; RefOutput_geoColor; }  # unwired: MainOutput, RefOutput_geoColor
reference_output_3 = CodeBlock { ref; }  # unwired: ref

# group: Visual Manager
visual_켜기_끄기_3 = BoolSelector(false)
visual_manager_3 = Python(IN[0]=output_3.RefOutput_geoColor, IN[1]=visual_켜기_끄기_3)  # CPython3; same code as visual_manager

# group: Output Manager
output_4 = CodeBlock { MainOutput; RefOutput_geoColor; }  # unwired: MainOutput, RefOutput_geoColor
reference_output_4 = CodeBlock { ref; }  # unwired: ref

# group: Visual Manager
visual_켜기_끄기_4 = BoolSelector(false)
visual_manager_4 = Python(IN[0]=output_4.RefOutput_geoColor, IN[1]=visual_켜기_끄기_4)  # CPython3; same code as visual_manager

# group: Output Manager
output_5 = CodeBlock { MainOutput; RefOutput_geoColor; }  # unwired: MainOutput, RefOutput_geoColor
reference_output_5 = CodeBlock { ref; }  # unwired: ref

# group: Visual Manager
visual_켜기_끄기_5 = BoolSelector(false)
visual_manager_5 = Python(IN[0]=output_5.RefOutput_geoColor, IN[1]=visual_켜기_끄기_5)  # CPython3; same code as visual_manager

# group: Output Manager
output_6 = CodeBlock { MainOutput; RefOutput_geoColor; }  # unwired: MainOutput, RefOutput_geoColor
reference_output_6 = CodeBlock { ref; }  # unwired: ref

# group: Visual Manager
visual_켜기_끄기_6 = BoolSelector(false)
visual_manager_6 = Python(IN[0]=output_6.RefOutput_geoColor, IN[1]=visual_켜기_끄기_6)  # CPython3; same code as visual_manager

code_block_4 = CodeBlock(i=select_target_family_element_and_2) { i; }

# group: Input Manager
value_for_import_from_others = CodeBlock(MainInput=code_block_4) { MainInput; RefInput1; RefInput2; }  # unwired: RefInput1, RefInput2

# group: <Func 1>Roof Waterproofing
code_block_5 = CodeBlock { "TargetElements"; }
valueAtKey = DesignScript.Builtin.Dictionary.ValueAtKey(dictionary=value_for_import_from_others.MainInput, key=code_block_5)
geometry = Element.Geometry(element=valueAtKey)
explode = Geometry.Explode(geometry=geometry)
code_block_6 = CodeBlock { 0; }
code_block_7 = CodeBlock { 0.5; }
normalAtParameter = Surface.NormalAtParameter(surface=explode, u=code_block_7, v=code_block_7)
Z = Vector.Z(vector=normalAtParameter)
eq = code_block_6 == Z
filterByBoolMask = List.FilterByBoolMask(list=explode, mask=eq)
flatten = List.Flatten(list=filterByBoolMask.out)
code_block_8 = CodeBlock { 0.5; }
normalAtParameter_2 = Surface.NormalAtParameter(surface=flatten, u=code_block_8, v=code_block_8)
Z_2 = Vector.Z(vector=normalAtParameter_2)
code_block_9 = CodeBlock(a=Z_2) { a<0; }
filterByBoolMask_2 = List.FilterByBoolMask(list=flatten, mask=code_block_9)
perimeterCurves = Surface.PerimeterCurves(surface=filterByBoolMask_2.in)
flatten_2 = List.Flatten(list=perimeterCurves)
ZAxis = Vector.ZAxis()
membrane_치켜올림 = DoubleInput(500)  # graph input
extrude = Curve.Extrude(curve=flatten_2, direction=ZAxis, distance=membrane_치켜올림)
join = List.Join(list0=filterByBoolMask_2.in, list1=extrude)
area = Surface.Area(surface=join)
sum = Math.Sum(values=area)
code_block_10 = CodeBlock(i=sum) { Math.Round(List.Flatten(i)/1000000, 2); }
code_block_11 = CodeBlock { "M2"; }
count = List.Count(list=code_block_10)
ofRepeatedItem = List.OfRepeatedItem(item=code_block_11, amount=count)
# note: <Func>
code_block_12 = CodeBlock(FuncValues=code_block_10, FuncValuesUnit=ofRepeatedItem)
# ---------- code_block_12.designscript (4 lines) ----------
{
"FuncValues": _FuncValues,
"FuncValuesUnit": _FuncValuesUnit
};
# ----------------------------------------

# group: Output Manager
reference_output_7 = CodeBlock(ref=filterByBoolMask_2.in) { ref; }
output_7 = CodeBlock { MainOutput; RefOutput_geoColor; }  # unwired: MainOutput, RefOutput_geoColor

# group: Input Manager
value_for_import_from_others_2 = CodeBlock(MainInput=code_block_4, RefInput1=reference_output_7) { MainInput; RefInput1; RefInput2; }  # unwired: RefInput2

# group: <Func 3>Roof PE Sheet
code_block_13 = CodeBlock { "TargetElements"; }
# note: <Func>
valueAtKey_2 = DesignScript.Builtin.Dictionary.ValueAtKey(dictionary=value_for_import_from_others_2.MainInput, key=code_block_13)

# group: Input Manager
value_for_import_from_others_3 = CodeBlock(MainInput=code_block_4, RefInput1=reference_output_7) { MainInput; RefInput1; RefInput2; }  # unwired: RefInput2

# group: <Func 2>Roof Insulation
code_block_14 = CodeBlock { "TargetElements"; }
# note: <Func>
valueAtKey_3 = DesignScript.Builtin.Dictionary.ValueAtKey(dictionary=value_for_import_from_others_3.MainInput, key=code_block_14)

# group: Visual Manager
visual_켜기_끄기_7 = BoolSelector(false)
visual_manager_7 = Python(IN[0]=output_7.RefOutput_geoColor, IN[1]=visual_켜기_끄기_7)  # CPython3; same code as visual_manager

code_block_15 = CodeBlock(i=select_target_family_element_and) { i; }

# group: Input Manager
value_for_import_from_others_4 = CodeBlock(MainInput=code_block_15) { MainInput; RefInput1; RefInput2; }  # unwired: RefInput1, RefInput2

# group: <Func 1>Structural Concrete
code_block_16 = CodeBlock { "TargetElements"; }
# note: <Func>
valueAtKey_4 = DesignScript.Builtin.Dictionary.ValueAtKey(dictionary=value_for_import_from_others_4.MainInput, key=code_block_16)

geometry_2 = Element.Geometry(element=valueAtKey_4)
volume = Solid.Volume(solid=geometry_2)
code_block_17 = CodeBlock(i=volume) { Math.Round(List.Flatten(i)/1000000000,2); }
code_block_18 = CodeBlock { "M3"; }
count_2 = List.Count(list=code_block_17)
ofRepeatedItem_2 = List.OfRepeatedItem(item=code_block_18, amount=count_2)
code_block_19 = CodeBlock(FuncValues=code_block_17, FuncValuesUnit=ofRepeatedItem_2)  # same code as code_block_12

# group: Input Manager
value_for_import_from_others_5 = CodeBlock(MainInput=code_block_15) { MainInput; RefInput1; RefInput2; }  # unwired: RefInput1, RefInput2

# group: <Func 3>Superstructure Work Rebar Work
code_block_20 = CodeBlock { "TargetElements"; }
# note: <Func>
valueAtKey_5 = DesignScript.Builtin.Dictionary.ValueAtKey(dictionary=value_for_import_from_others_5.MainInput, key=code_block_20)

code_block_21 = CodeBlock { "Volume"; }
# note: <Func>
getParameterValueByName = Element.GetParameterValueByName(element=valueAtKey_5, parameterName=code_block_21)
sog_철근비 = DoubleInput(0)  # graph input
mul = getParameterValueByName * sog_철근비
code_block_22 = CodeBlock(i=mul) { Math.Round(List.Flatten(i)/1, 2); }
code_block_23 = CodeBlock { "TON"; }
count_3 = List.Count(list=code_block_22)
ofRepeatedItem_3 = List.OfRepeatedItem(item=code_block_23, amount=count_3)
code_block_24 = CodeBlock(FuncValues=code_block_22, FuncValuesUnit=ofRepeatedItem_3)  # same code as code_block_12

# group: Input Manager
value_for_import_from_others_6 = CodeBlock(MainInput=code_block_15) { MainInput; RefInput1; RefInput2; }  # unwired: RefInput1, RefInput2

# group: <Func 2>Superstructure Work Form Work (빔거더 중첩구간 제외)
code_block_25 = CodeBlock { "TargetElements"; }
valueAtKey_6 = DesignScript.Builtin.Dictionary.ValueAtKey(dictionary=value_for_import_from_others_6.MainInput, key=code_block_25)
geometry_3 = Element.Geometry(element=valueAtKey_6)
explode_2 = Geometry.Explode(geometry=geometry_3)
code_block_26 = CodeBlock { 0; }
code_block_27 = CodeBlock { 0.5; }
normalAtParameter_3 = Surface.NormalAtParameter(surface=explode_2, u=code_block_27, v=code_block_27)
Z_3 = Vector.Z(vector=normalAtParameter_3)
eq_2 = code_block_26 == Z_3
filterByBoolMask_3 = List.FilterByBoolMask(list=explode_2, mask=eq_2)
flatten_3 = List.Flatten(list=filterByBoolMask_3.out)
code_block_28 = CodeBlock { 0.5; }
normalAtParameter_4 = Surface.NormalAtParameter(surface=flatten_3, u=code_block_28, v=code_block_28)
Z_4 = Vector.Z(vector=normalAtParameter_4)
code_block_29 = CodeBlock(a=Z_4) { a<0; }
filterByBoolMask_4 = List.FilterByBoolMask(list=flatten_3, mask=code_block_29)
flatten_4 = List.Flatten(list=filterByBoolMask_4.in)
getJoinedElements = Element.GetJoinedElements(element=valueAtKey_6)
flatten_5 = List.Flatten(list=getJoinedElements)
name = Element.Name(element=getJoinedElements)
flatten_6 = List.Flatten(list=name)
string_from_object = FromObject(object=flatten_6)
code_block_30 = CodeBlock { "Slab"; }
contains = String.Contains(string=string_from_object, searchFor=code_block_30)
filterByBoolMask_5 = List.FilterByBoolMask(list=flatten_5, mask=contains)
flatten_7 = List.Flatten(list=filterByBoolMask_5.out)
geometry_4 = Element.Geometry(element=flatten_7)
flatten_8 = List.Flatten(list=geometry_4)
byUnion = Solid.ByUnion(solids=flatten_8)
subtractFrom = Surface.SubtractFrom(surface=flatten_4, trimmingEntity=byUnion)
area_2 = Surface.Area(surface=subtractFrom)
sum_2 = Math.Sum(values=area_2)
code_block_31 = CodeBlock(i=sum_2) { Math.Round(List.Flatten(i)/1000000, 2); }
code_block_32 = CodeBlock { "M2"; }
count_4 = List.Count(list=code_block_31)
ofRepeatedItem_4 = List.OfRepeatedItem(item=code_block_32, amount=count_4)
code_block_33 = CodeBlock(FuncValues=code_block_31, FuncValuesUnit=ofRepeatedItem_4)  # same code as code_block_12

# group: Output Manager
output_8 = CodeBlock { MainOutput; RefOutput_geoColor; }  # unwired: MainOutput, RefOutput_geoColor
reference_output_8 = CodeBlock(ref=flatten_4) { ref; }

# group: Visual Manager
visual_켜기_끄기_8 = BoolSelector(false)
visual_manager_8 = Python(IN[0]=output_8.RefOutput_geoColor, IN[1]=visual_켜기_끄기_8)  # CPython3; same code as visual_manager

# group: Input Manager
value_for_import_from_others_7 = CodeBlock(MainInput=code_block_15, RefInput1=reference_output_8) { MainInput; RefInput1; RefInput2; }  # unwired: RefInput2

code_block_34 = CodeBlock(i=value_for_import_from_others_7.RefInput1) { i; }
area_3 = Surface.Area(surface=code_block_34)
sum_3 = Math.Sum(values=area_3)
code_block_35 = CodeBlock(i=sum_3) { Math.Round(List.Flatten(i)/1000000, 2); }
code_block_36 = CodeBlock { "M2"; }
count_5 = List.Count(list=code_block_35)
ofRepeatedItem_5 = List.OfRepeatedItem(item=code_block_36, amount=count_5)
code_block_37 = CodeBlock(FuncValues=code_block_35, FuncValuesUnit=ofRepeatedItem_5)  # same code as code_block_12
code_block_38 = CodeBlock(i=value_for_import_from_others_3.RefInput1) { i; }
area_4 = Surface.Area(surface=code_block_38)
sum_4 = Math.Sum(values=area_4)
code_block_39 = CodeBlock(i=sum_4) { Math.Round(List.Flatten(i)/1000000, 2); }
code_block_40 = CodeBlock { "M2"; }
count_6 = List.Count(list=code_block_39)
ofRepeatedItem_6 = List.OfRepeatedItem(item=code_block_40, amount=count_6)
code_block_41 = CodeBlock(FuncValues=code_block_39, FuncValuesUnit=ofRepeatedItem_6)  # same code as code_block_12
code_block_42 = CodeBlock(i=value_for_import_from_others_2.RefInput1) { i; }
area_5 = Surface.Area(surface=code_block_42)
sum_5 = Math.Sum(values=area_5)
code_block_43 = CodeBlock(i=sum_5) { Math.Round(List.Flatten(i)/1000000, 2); }
code_block_44 = CodeBlock { "M2"; }
count_7 = List.Count(list=code_block_43)
ofRepeatedItem_7 = List.OfRepeatedItem(item=code_block_44, amount=count_7)
code_block_45 = CodeBlock(FuncValues=code_block_43, FuncValuesUnit=ofRepeatedItem_7)  # same code as code_block_12

# group: Input Manager
value_for_import_from_others_8 = CodeBlock(MainInput=code_block_4) { MainInput; RefInput1; RefInput2; }  # unwired: RefInput1, RefInput2

# group: <Func 4>Roof Protective Concrete
code_block_46 = CodeBlock { "TargetElements"; }
# note: <Func>
valueAtKey_7 = DesignScript.Builtin.Dictionary.ValueAtKey(dictionary=value_for_import_from_others_8.MainInput, key=code_block_46)

python_script = Python(IN[0]=valueAtKey_7)  # CPython3
# ---------- python_script.python (61 lines) ----------
#Alban de Chasteigner 2018
#twitter : @geniusloci_bim
#geniusloci.bim@gmail.com
#https://github.com/albandechasteigner/GeniusLociForDynamo

import clr
clr.AddReference('RevitAPI')
import Autodesk
from Autodesk.Revit.DB import *

clr.AddReference('RevitServices')
import RevitServices
from RevitServices.Persistence import DocumentManager
uiapp = DocumentManager.Instance.CurrentUIApplication
app = uiapp.Application
version=int(app.VersionNumber)

elements = UnwrapElement(IN[0]) if isinstance(IN[0],list) else [UnwrapElement(IN[0])]
	
layerIds,layermat,layerfunc,layerwidth,layers,strucLayer,coreLayer,deckProfile = [],[],[],[],[],[],[],[]

for elem in elements :
	ids,mat,func,width,core,deck=[],[],[],[],[],[]
	doc =  elem .Document
	if version < 2021:
		UIunit = doc.GetUnits().GetFormatOptions(UnitType.UT_Length).DisplayUnits
	else:
		UIunit = doc.GetUnits().GetFormatOptions(SpecTypeId.Length).GetUnitTypeId()
	if isinstance(elem, ElementType):
		famType=elem
	elif isinstance(elem, Wall) and not elem.IsStackedWall and not elem.WallType.Kind == WallKind.Curtain :
		famType = elem.WallType
	elif isinstance(elem, Floor):
		famType = elem.FloorType
	elif isinstance(elem, FootPrintRoof) or isinstance(elem, ExtrusionRoof) or isinstance(elem, RoofBase) :
		famType = elem.RoofType
	elif isinstance(elem, Ceiling) or isinstance(elem, FaceWall) :
		famType = doc.GetElement(elem.GetTypeId())
	else: famType = None
	if famType :
		compStr = famType.GetCompoundStructure()
		# Get and sort layers by Id in reverse order (Highest id first)...
		layers = list(compStr.GetLayers())
		layers.sort(key=lambda x: x.LayerId)
		for l in layers:	
			ids.append(l.LayerId)
			mat.append(famType.Document.GetElement(l.MaterialId))
			func.append(l.Function)
			width.append(UnitUtils.ConvertFromInternalUnits(l.Width,UIunit))
			core.append(compStr.IsCoreLayer(l.LayerId))
			deck.append(doc.GetElement(l.DeckProfileId))
	layerIds.append(ids)
	layermat.append(mat)
	layerfunc.append(func)
	layerwidth.append(width)
	strucLayer.append(layers)
	coreLayer.append(core)
	deckProfile.append(deck)
	
if isinstance(IN[0], (list)): OUT = layerfunc,layermat,layerwidth,layerIds,strucLayer,coreLayer,deckProfile
else: OUT = layerfunc[0],layermat[0],layerwidth[0],layerIds[0],strucLayer[0],coreLayer[0],deckProfile[0]
# ----------------------------------------
code_block_47 = CodeBlock(x=python_script) { x[0]; x[1]; x[2]; x[3]; x[4]; x[5]; x[6]; }
code_block_48 = CodeBlock(LayerFunction=code_block_47.out0) { LayerFunction; }
watch_3 = Watch(code_block_48)
code_block_49 = CodeBlock(Index=code_block_47.out3) { Index; }
watch_4 = Watch(code_block_49)
code_block_50 = CodeBlock(Layers=code_block_47.out4) { Layers; }
watch_5 = Watch(code_block_50)
code_block_51 = CodeBlock(IsCoreLayer=code_block_47.out5) { IsCoreLayer; }
watch_6 = Watch(code_block_51)
code_block_52 = CodeBlock(StructuralDeckProfile=code_block_47.out6)
# ---------- code_block_52.designscript (2 lines) ----------
//Only for floors
StructuralDeckProfile;
# ----------------------------------------
watch_7 = Watch(code_block_52)
code_block_53 = CodeBlock { "Area"; }
getParameterValueByName_2 = Element.GetParameterValueByName(element=valueAtKey_7, parameterName=code_block_53)
watch_8 = Watch(getParameterValueByName_2)
code_block_54 = CodeBlock(Thickness=code_block_47.out2) { Thickness; }
watch_9 = Watch(code_block_54)
code_block_55 = CodeBlock(material=code_block_47.out1) { material; }
watch_10 = Watch(code_block_55)
name_2 = Material.Name(material=watch_10)
watch_11 = Watch(name_2)
code_block_56 = CodeBlock { "Protective"; }
contains_2 = String.Contains(string=watch_11, searchFor=code_block_56)
filterByBoolMask_6 = List.FilterByBoolMask(list=watch_9, mask=contains_2)
flatten_9 = List.Flatten(list=filterByBoolMask_6.in)
watch_12 = Watch(flatten_9)
code_block_57 = CodeBlock(area=watch_8, protectivethk=watch_12) { Math.Round(area*(protectivethk/1000),2); }
watch_13 = Watch(code_block_57)
code_block_58 = CodeBlock { "M3"; }
count_8 = List.Count(list=watch_13)
ofRepeatedItem_8 = List.OfRepeatedItem(item=code_block_58, amount=count_8)
code_block_59 = CodeBlock(FuncValues=watch_13, FuncValuesUnit=ofRepeatedItem_8)  # same code as code_block_12
categories_2 = Categories("OST_StructuralFraming")
all_elements_of_category_2 = ElementsOfCategory(Category=categories_2)
name_3 = Element.Name(element=all_elements_of_category_2)
string_from_object_2 = FromObject(object=name_3)
code_block_60 = CodeBlock { "TG"; }
contains_3 = String.Contains(string=string_from_object_2, searchFor=code_block_60)
filterByBoolMask_7 = List.FilterByBoolMask(list=all_elements_of_category_2, mask=contains_3)
geometry_5 = Element.Geometry(element=filterByBoolMask_7.out)

# group: <Func 4>Ceiling Painting
code_block_61 = CodeBlock { "TargetElements"; }
# note: <Func>
valueAtKey_8 = DesignScript.Builtin.Dictionary.ValueAtKey(dictionary=value_for_import_from_others_7.MainInput, key=code_block_61)

geometry_6 = Element.Geometry(element=valueAtKey_8)
categories_3 = Categories("OST_StructuralColumns")
all_elements_of_category_3 = ElementsOfCategory(Category=categories_3)
geometry_7 = Element.Geometry(element=all_elements_of_category_3)
join_2 = List.Join(list0=geometry_6, list1=geometry_7)
flatten_10 = List.Flatten(list=join_2)
byUnion_2 = Solid.ByUnion(solids=flatten_10)
join_3 = List.Join(list0=geometry_5, list1=byUnion_2)
flatten_11 = List.Flatten(list=join_3)
byUnion_3 = Solid.ByUnion(solids=flatten_11)
explode_3 = Geometry.Explode(geometry=byUnion_3)
byJoinedSurfaces = PolySurface.ByJoinedSurfaces(surfaces=explode_3)
categories_4 = Categories("OST_Rooms")
all_elements_of_category_4 = ElementsOfCategory(Category=categories_4)
categories_5 = Categories("OST_Ceilings")
all_elements_of_category_5 = ElementsOfCategory(Category=categories_5)
geometry_8 = Element.Geometry(element=all_elements_of_category_5)
flatten_12 = List.Flatten(list=geometry_8)
byUnion_4 = Solid.ByUnion(solids=flatten_12)
geometry_9 = Element.Geometry(element=all_elements_of_category_4)
flatten_13 = List.Flatten(list=geometry_9)
doesIntersect = Geometry.DoesIntersect(geometry=byUnion_4, other=flatten_13)
filterByBoolMask_8 = List.FilterByBoolMask(list=all_elements_of_category_4, mask=doesIntersect)
watch_14 = Watch(filterByBoolMask_8.out)
coreBoundary = Room.CoreBoundary(room=watch_14)
flatten_14 = List.Flatten(list=coreBoundary)
byJoinedCurves = PolyCurve.ByJoinedCurves(curves=flatten_14)
flatten_15 = List.Flatten(list=geometry_5)
byUnion_5 = Solid.ByUnion(solids=flatten_15)
explode_4 = Geometry.Explode(geometry=byUnion_5)
code_block_62 = CodeBlock { 0.5; }
pointAtParameter = Surface.PointAtParameter(surface=explode_4, u=code_block_62, v=code_block_62)
Z_5 = Point.Z()  # unwired: point
minimumItemByKey = List.MinimumItemByKey(list=pointAtParameter, keyFunction=Z_5)
watch_15 = Watch(minimumItemByKey)
Z_6 = Point.Z(point=watch_15)
code_block_63 = CodeBlock { 2; }
round = Math.Round(number=Z_6, digits=code_block_63)
levels = Levels("G.L")
elevation = Level.Elevation(level=levels)
code_block_64 = CodeBlock(a=round, b=elevation) { a-b; }
translate = Geometry.Translate(geometry=byJoinedCurves, zTranslation=code_block_64)
elementType = Element.ElementType(element=all_elements_of_category_2)
code_block_65 = CodeBlock { "Height"; }
getParameterValueByName_3 = Element.GetParameterValueByName(element=elementType, parameterName=code_block_65)
string_from_object_3 = FromObject(object=getParameterValueByName_3)
maximumItem = List.MaximumItem()  # unwired: list
maximumItemByKey = List.MaximumItemByKey(list=string_from_object_3, keyFunction=maximumItem)
watch_16 = Watch(maximumItemByKey)
toNumber = String.ToNumber(string=watch_16)
translate_2 = Geometry.Translate(geometry=translate, zTranslation=toNumber)
join_4 = List.Join(list0=translate_2, list1=translate)
byLoft = Solid.ByLoft(crossSections=join_4)
intersectAll = Geometry.IntersectAll(geometry=byJoinedSurfaces, others=byLoft)
code_block_66 = CodeBlock { 0.5; }
normalAtParameter_5 = Surface.NormalAtParameter(surface=intersectAll, u=code_block_66, v=code_block_66)
X = Vector.X(vector=normalAtParameter_5)
code_block_67 = CodeBlock { 15; }
round_2 = Math.Round(number=X, digits=code_block_67)
code_block_68 = CodeBlock { 0; }
eq_3 = round_2 == code_block_68
filterByBoolMask_9 = List.FilterByBoolMask(list=intersectAll, mask=eq_3)
flatten_16 = List.Flatten()  # unwired: list
code_block_69 = CodeBlock { 1; }
gt = X > code_block_69
lt = round_2 < code_block_69
byJoinedSurfaces_2 = PolySurface.ByJoinedSurfaces(surfaces=intersectAll)
flatten_17 = List.Flatten(list=geometry_6)
byUnion_6 = Solid.ByUnion(solids=flatten_17)
watch_17 = Watch(byUnion_6)
difference = Surface.Difference(surface=byJoinedSurfaces_2, others=watch_17)
difference_2 = Solid.Difference(solid=watch_17, other=byJoinedSurfaces)
flatten_18 = List.Flatten(list=watch_17)
difference_3 = Surface.Difference()  # unwired: surface, others
intersectAll_2 = Geometry.IntersectAll(geometry=byUnion_3, others=byLoft)
explode_5 = Geometry.Explode(geometry=intersectAll_2)
flatten_19 = List.Flatten(list=explode_5)
하부노출면_빔_측면_포함_추출 = Python(IN[0]=flatten_19)  # CPython3
# ---------- 하부노출면_빔_측면_포함_추출.python (37 lines) ----------
# Load the Python Standard and DesignScript Libraries
import sys
import clr
clr.AddReference('ProtoGeometry')
from Autodesk.DesignScript.Geometry import *

# The inputs to this node will be stored as a list in the IN variables.
dataEnteringNode = IN
srfGroups = IN[0]

# Place your code below this line
def findBeneathSrf(srfGroup):
    result = []
    #upperSrfs = [i for i in srfGroup if i.NormalAtParameter(0.5,0.5).Z != 1]
    측면제외 = [i for i in srfGroup if round(i.NormalAtParameter(0.5,0.5).Z) != 0]
    중점Z = [i.PointAtParameter(0.5,0.5).Z for i in 측면제외]
    중점최고z = max(중점Z)
    upperSrfs = [i for i in 측면제외 if i.PointAtParameter(0.5,0.5).Z==중점최고z]
    headCrvs = []
    for i in upperSrfs:
        headCrv = PolyCurve.ByJoinedCurves(i.PerimeterCurves())
        headCrvs.append(headCrv)
    
    for i in srfGroup:
        tmp=[]
        for j in headCrvs:
            if i.DoesIntersect(j):
                tmp.append(False)
            else:
                tmp.append(True)
        if all(tmp):
            result.append(i)
    
    return result

# Assign your output to the OUT variable.
OUT = findBeneathSrf(srfGroups)#[findBeneathSrf(i) for i in srfGroups]
# ----------------------------------------
code_block_70 = CodeBlock { 0.5; }
