# Dynamo graph 02 Stairs (220104).dyn (Dynamo 2.12.0.5650)

# group: Primary Input : Excel & Revit Elements
categories = Categories("OST_Stairs")
all_elements_of_category = ElementsOfCategory(Category=categories)
string_from_web = Python()  # CPython3; unwired: IN[0]
# ---------- string_from_web.python (19 lines) ----------
# Load the Python Standard and DesignScript Libraries
import sys
import clr
clr.AddReference('ProtoGeometry')
from Autodesk.DesignScript.Geometry import *
import urllib.request

# The inputs to this node will be stored as a list in the IN variables.
dataEnteringNode = IN
inputURL = "https://raw.githubusercontent.com/HNANmal/mQ/master/Hdynlib/General/ImportExcel.py"

# Place your code below this line
req = urllib.request
data = req.urlopen(inputURL)

result = data.read().decode("utf-8")

# Assign your output to the OUT variable.
OUT = result
# ----------------------------------------
file_path = Filename("..\..\220110\DMS(Data Matching Schedule)_R0(Seq2)_220110.xlsx")  # graph input
sheet_name = CodeBlock { "Stairs"; }
github_python_import_excel_by = PythonStringNode(script=string_from_web, IN[0]=file_path, IN[1]=sheet_name)  # "Github_Python@Import Excel(By OpenpyXl)"; CPython3
code_block = CodeBlock(InputElement=all_elements_of_category, InputData=github_python_import_excel_by) { _InputElement; _InputData; }

# group: GetFull WMCodeDescription PerElement
exceldatamanagernode_for_stair = Python(IN[0]=code_block._InputElement, IN[1]=code_block._InputData)  # "ExcelDataManagerNode//for stair only"; CPython3
# ---------- exceldatamanagernode_for_stair.python (285 lines) ----------
# Load the Python Standard and DesignScript Libraries
import os
import sys
sys.path.append(os.getenv('LOCALAPPDATA').replace('\\','\\\\') + r'\Programs\Python\Python39\Lib\site-packages')
import clr
clr.AddReference('RevitAPI')
import Autodesk

clr.AddReference('ProtoGeometry')
from Autodesk.DesignScript.Geometry import *

clr.AddReference('RevitNodes')
import Revit
clr.ImportExtensions(Revit.Elements)

clr.ImportExtensions(Revit.GeometryConversion)
clr.ImportExtensions(Revit.GeometryReferences)

clr.AddReference('RevitServices')
import RevitServices
from RevitServices.Persistence import DocumentManager
from RevitServices.Transactions import TransactionManager

doc = DocumentManager.Instance.CurrentDBDocument

import random
import itertools
from functools import reduce
from collections import Iterable
import datetime
import openpyxl

def iterable(obj):
    return isinstance(obj, Iterable)

def findUnique(inputs):
    result = []
    for i in inputs:
        if i in result:
            pass
        else:
            result.append(i)
    return result

# The inputs to this node will be stored as a list in the IN variables.
dataEnteringNode = IN
inputElements = IN[0]
inputData = IN[1]
#inputSheetName = IN[2]

def importExcel(path, SheetNameIn):
    wb_obj = openpyxl.load_workbook(str(path), data_only=True)
    sheet_obj = wb_obj.get_sheet_by_name(str(SheetNameIn))

    m_row = sheet_obj.max_row
    m_col = sheet_obj.max_column

    listOut = []

    for i in range(1, m_row +1):
        listTemp = []
        for j in range(1, m_col + 1):
            cell_obj = sheet_obj.cell(row=i, column=j)
            listTemp.append(cell_obj.value)
            if len(listTemp) == m_col:
                listOut.append(listTemp)
    return listOut

def getUsedFamilyTypeOfModeling(elements):
    familyCode = list(map(lambda x: x.Name.split('_')[0], elements))
    unq_familyCode = findUnique(familyCode)
    return unq_familyCode

def getUsedFamilyTypeOfStair(elements):
    familyCode = list(map(lambda x: x.GetParameterValueByName("Type").Name.split('_')[0], elements))
    unq_familyCode = findUnique(familyCode)
    return unq_familyCode
    
def createExcelDataDictionary(values):
    result = {}
    for i in range(len(values)):
        result[str(i)] = values[i]
    return result

def findTargetIndex(targets, list):
    result = []
    for target in targets:
        for i in range(len(list)):
            if target in str(list[i]):
                result.append(i)
            else:
                pass
    result.sort()
    return result
    
def GetValueAtKeys(keys, dictionary):
    result = [] 
    for i in keys:
        result.append(dictionary[str(i)])
    return result


# Place your code below this line
usedFamilyTypeOfModeling = getUsedFamilyTypeOfStair(inputElements)
excelWholeDataSet = inputData#importExcel(inputFilePath, inputSheetName)
trExcelWholeDataSet = list(zip(*excelWholeDataSet))
excelColumnDataSet = createExcelDataDictionary(trExcelWholeDataSet)
excelRowDataSet = createExcelDataDictionary(excelWholeDataSet)
ColumnIndexOfUsedFamilyType = findTargetIndex(usedFamilyTypeOfModeling, trExcelWholeDataSet)
ColDataSetOfUsedFamilyType = GetValueAtKeys(ColumnIndexOfUsedFamilyType, excelColumnDataSet)
materialPerElementFromModeling = []
for i in inputElements:
    materialPerElementFromModeling.append(i.GetMaterials())
#list(map(lambda x: x.GetMaterials, inputElements)) "맵함수로 처리하면 리스트화 할 때 타입 변환 오류 남"

targetWMRowIndex = []
for i in ColDataSetOfUsedFamilyType:
    targetWMRowIndex.append(findTargetIndex(['000'], i))

rowDataSetOfUsedWM = []
for i in targetWMRowIndex:
    rowDataSetOfUsedWM.append(GetValueAtKeys(i, excelRowDataSet))

workGroup = []
for i in rowDataSetOfUsedWM:
    tmp = []
    for j in i:
        tmp.append(j[0])
    workGroup.append(tmp)
    
workMaster = []
for i in range(len(ColDataSetOfUsedFamilyType)):
    tmp=[]
    for k in targetWMRowIndex[i]:
        tmp.append(ColDataSetOfUsedFamilyType[i][k])
    workMaster.append(tmp)

matchedWM = []
for i in range(len(workGroup)):
    tmp = []
    for j in range(len(workGroup[i])):
        fullWM = workGroup[i][j] +"-"+ workMaster[i][j]
        tmp.append(fullWM)
    matchedWM.append(tmp)

matchedWorkGruopAndMasterCode = []
for i in matchedWM:
    if len(i) > 0:
        matchedWorkGruopAndMasterCode.append(i)
    else:
        pass

matchedWMDescription = []
for i in rowDataSetOfUsedWM:
    tmp=[]
    for j in i:
        tmp.append(j[1] +" "+ j[2] +" "+ j[3] +" "+ "("+ j[4] +")")
    if len(tmp) > 0:
        matchedWMDescription.append(tmp)
    else:
        pass

matchedWMUnit = []
for i in rowDataSetOfUsedWM:
    tmp=[]
    for j in i:
        tmp.append(j[4])
    if len(tmp) > 0:
        matchedWMUnit.append(tmp)
    else:
        pass

matchedWorkGruopAndMasterCode_flat = list(itertools.chain(*matchedWorkGruopAndMasterCode))
matchedWMDescription_flat = list(itertools.chain(*matchedWMDescription))

dic_WMandDescription_Excel = {}
for i in range(len(matchedWorkGruopAndMasterCode_flat)):
    dic_WMandDescription_Excel[matchedWorkGruopAndMasterCode_flat[i]] = matchedWMDescription_flat[i]

usedFamilyTypeInExcelOrder = list(map(lambda x: x[3], ColDataSetOfUsedFamilyType))
usedFamilyCodeInExcelOrder = findUnique(list(map(lambda x: x.split('_')[0], usedFamilyTypeInExcelOrder)))

dic_FamilyCodeandWM = {}
for i in range(len(usedFamilyCodeInExcelOrder)):
    dic_FamilyCodeandWM[usedFamilyCodeInExcelOrder[i]] = matchedWorkGruopAndMasterCode[i]

workMasterCodePerElement = []
#familyCodePerElem = list(map(lambda x: x.Name.split('_')[0], inputElements))
familyCodePerElem = list(map(lambda x: x.GetParameterValueByName("Type").Name.split('_')[0], inputElements)) ## Stair 용으로만 사용
for i in familyCodePerElem:
    workMasterCodePerElement.append(dic_FamilyCodeandWM[i])

materialNamePerElem = []
for i in materialPerElementFromModeling:
    tmp = []
    for j in i:
        tmp.append(j.Name)
    materialNamePerElem.append(tmp)

WMPerElementFromModeling = []
for i in materialNamePerElem:
    tmp = []
    for j in i:
        tmp.append(j.split('_')[0])
    WMPerElementFromModeling.append(tmp)

specPerElementFromModeling = []
for i in materialNamePerElem:
    tmp = []
    for j in i:
        a = j.split('_')
        del a[0]
        b = " ".join(a)
        tmp.append(b)
    specPerElementFromModeling.append(tmp)

WMPerElementFromModeling_flat = list(itertools.chain(*WMPerElementFromModeling))
specPerElementFromModeling_flat = list(itertools.chain(*specPerElementFromModeling))

dic_WMandDescription_Model = {}
for i in range(len(WMPerElementFromModeling_flat)):
    dic_WMandDescription_Model[WMPerElementFromModeling_flat[i]] = specPerElementFromModeling_flat[i]

def findAllKeys(dict):
    result = []
    for key in dict.keys():
        result.append(key)
    return result

def findAllValues(dict):
    result = []
    for key in dict.keys():
        result.append(dict[key])
    return result

keys_WMandDescription_Model = findAllKeys(dic_WMandDescription_Model)
keys_WMandDescription_Excel = findAllKeys(dic_WMandDescription_Excel)

keys_WMandDescription_Both = list(set(keys_WMandDescription_Model + keys_WMandDescription_Excel))
values_WMandDescription_Both = []
for i in keys_WMandDescription_Both:
    if i in keys_WMandDescription_Model:
        values_WMandDescription_Both.append(dic_WMandDescription_Model[i])
    else:
        values_WMandDescription_Both.append(dic_WMandDescription_Excel[i])

dic_WMandDescription_Both = {}
for i in range(len(keys_WMandDescription_Both)):
    dic_WMandDescription_Both[keys_WMandDescription_Both[i]] = values_WMandDescription_Both[i]

workMasterCodePerElementFromBoth = []
for i in range(len(workMasterCodePerElement)):
    #tmp = []
    a = WMPerElementFromModeling[i] + workMasterCodePerElement[i]
    b = findUnique(a)
    workMasterCodePerElementFromBoth.append(b)

specPerElement = []
for i in workMasterCodePerElementFromBoth:
    tmp = []
    for j in i:
        tmp.append(dic_WMandDescription_Both[j])
    specPerElement.append(tmp)

fullWMCodeDescriptionPerElement = []
for i in range(len(workMasterCodePerElementFromBoth)):
    tmp = []
    for j in range(len(workMasterCodePerElementFromBoth[i])):
        a = workMasterCodePerElementFromBoth[i][j] +": "+ specPerElement[i][j]
        tmp.append(a)
    fullWMCodeDescriptionPerElement.append(tmp)

fullWMinfo = {
"AllElement": inputElements,
"WorkMasterCodePerFamilyType": dic_FamilyCodeandWM,
"WorkMasterCodePerElementBoth": workMasterCodePerElementFromBoth,
"FullWMCodeDescriptionPerElement": fullWMCodeDescriptionPerElement
}



result = fullWMinfo

# Assign your output to the OUT variable.
OUT = result
# ----------------------------------------

# group: Organize AllElementInform AsDictionary
set_up_all_element_inform_as = Python(IN[0]=exceldatamanagernode_for_stair)  # "Set Up All Element Inform as Dictionary//for stair only"; CPython3
# ---------- set_up_all_element_inform_as.python (121 lines) ----------
# Load the Python Standard and DesignScript Libraries
import os
import sys
sys.path.append(os.getenv('LOCALAPPDATA').replace('\\','\\\\') + r'\Programs\Python\Python39\Lib\site-packages')
import clr
clr.AddReference('RevitAPI')
import Autodesk

clr.AddReference('ProtoGeometry')
from Autodesk.DesignScript.Geometry import *

clr.AddReference('RevitNodes')
import Revit
clr.ImportExtensions(Revit.Elements)

clr.ImportExtensions(Revit.GeometryConversion)
clr.ImportExtensions(Revit.GeometryReferences)

clr.AddReference('RevitServices')
import RevitServices
from RevitServices.Persistence import DocumentManager
from RevitServices.Transactions import TransactionManager

doc = DocumentManager.Instance.CurrentDBDocument

import random
import itertools
from functools import reduce
from collections import Iterable
import datetime
import openpyxl

def iterable(obj):
    return isinstance(obj, Iterable)

def findUnique(inputs):
    result = []
    for i in inputs:
        if i in result:
            pass
        else:
            result.append(i)
    return result

# The inputs to this node will be stored as a list in the IN variables.
dataEnteringNode = IN
inputDict = IN[0]


def importExcel(path, SheetNameIn):
    wb_obj = openpyxl.load_workbook(str(path), data_only=True)
    sheet_obj = wb_obj.get_sheet_by_name(str(SheetNameIn))

    m_row = sheet_obj.max_row
    m_col = sheet_obj.max_column

    listOut = []

    for i in range(1, m_row +1):
        listTemp = []
        for j in range(1, m_col + 1):
            cell_obj = sheet_obj.cell(row=i, column=j)
            listTemp.append(cell_obj.value)
            if len(listTemp) == m_col:
                listOut.append(listTemp)
    return listOut

def getUsedFamilyTypeOfModeling(elements):
    familyCode = list(map(lambda x: x.Name.split('_')[0], elements))
    unq_familyCode = findUnique(familyCode)
    return unq_familyCode
    
def createExcelDataDictionary(values):
    result = {}
    for i in range(len(values)):
        result[str(i)] = values[i]
    return result

def findTargetIndex(targets, list):
    result = []
    for target in targets:
        for i in range(len(list)):
            if target in str(list[i]):
                result.append(i)
            else:
                pass
    result.sort()
    return result
    
def GetValueAtKeys(keys, dictionary):
    result = [] 
    for i in keys:
        result.append(dictionary[str(i)])
    return result


# Place your code below this line
element = inputDict["AllElement"]
elementType = []
#for i in element:
#    elementType.append(i.Name)
for i in element: ## Stair용도로만 사용
    elementType.append(i.GetParameterValueByName("Type").Name)
familyCode = []
for i in elementType:
    familyCode.append(i.split("_")[0])
fullWMCodeDescriptionPerElement = inputDict["FullWMCodeDescriptionPerElement"]

resultDict = {
"Element": element,
"ElementType": elementType,
"FamilyCode": familyCode,
"FullWMCodeDescriptionPerElement": fullWMCodeDescriptionPerElement
}



result = resultDict

# Assign your output to the OUT variable.
OUT = result
# ----------------------------------------

# group: Select Target Family Element And Connected WorkMasters
code_block_2 = CodeBlock { 0; }
select_target_family_element_and = Python(IN[0]=set_up_all_element_inform_as, IN[1]=code_block_2)  # "Select Target Family Element And Connected WorkMasters"; CPython3
# ---------- select_target_family_element_and.python (140 lines) ----------
# Load the Python Standard and DesignScript Libraries
import os
import sys
sys.path.append(os.getenv('LOCALAPPDATA').replace('\\','\\\\') + r'\Programs\Python\Python39\Lib\site-packages')
import clr
clr.AddReference('RevitAPI')
import Autodesk

clr.AddReference('ProtoGeometry')
from Autodesk.DesignScript.Geometry import *

clr.AddReference('RevitNodes')
import Revit
clr.ImportExtensions(Revit.Elements)

clr.ImportExtensions(Revit.GeometryConversion)
clr.ImportExtensions(Revit.GeometryReferences)

clr.AddReference('RevitServices')
import RevitServices
from RevitServices.Persistence import DocumentManager
from RevitServices.Transactions import TransactionManager

doc = DocumentManager.Instance.CurrentDBDocument

import random
import itertools
from functools import reduce
from collections import Iterable
import datetime
import openpyxl

def iterable(obj):
    return isinstance(obj, Iterable)

def findUnique(inputs):
    result = []
    for i in inputs:
        if i in result:
            pass
        else:
            result.append(i)
    return result

# The inputs to this node will be stored as a list in the IN variables.
dataEnteringNode = IN
inputDict = IN[0]
inputIndex = IN[1]


def importExcel(path, SheetNameIn):
    wb_obj = openpyxl.load_workbook(str(path), data_only=True)
    sheet_obj = wb_obj.get_sheet_by_name(str(SheetNameIn))

    m_row = sheet_obj.max_row
    m_col = sheet_obj.max_column

    listOut = []

    for i in range(1, m_row +1):
        listTemp = []
        for j in range(1, m_col + 1):
            cell_obj = sheet_obj.cell(row=i, column=j)
            listTemp.append(cell_obj.value)
            if len(listTemp) == m_col:
                listOut.append(listTemp)
    return listOut

def getUsedFamilyTypeOfModeling(elements):
    familyCode = list(map(lambda x: x.Name.split('_')[0], elements))
    unq_familyCode = findUnique(familyCode)
    return unq_familyCode
    
def createExcelDataDictionary(values):
    result = {}
    for i in range(len(values)):
        result[str(i)] = values[i]
    return result

def findTargetIndex(targets, list):
    result = []
    for target in targets:
        for i in range(len(list)):
            if target in str(list[i]):
                result.append(i)
            else:
                pass
    result.sort()
    return result
    
def GetValueAtKeys(keys, dictionary):
    result = [] 
    for i in keys:
        result.append(dictionary[str(i)])
    return result


# Place your code below this line
fullWMCodeDescriptionPerElement = inputDict["FullWMCodeDescriptionPerElement"]
element = inputDict["Element"]
familyCode = inputDict["FamilyCode"]
familyCode_unique = findUnique(familyCode)
targetFamilyCode = familyCode_unique[inputIndex]
targetIndex = []
for i in range(len(familyCode)):
    if targetFamilyCode in familyCode[i]:
        targetIndex.append(i)
    else:
        pass

targetElements = []
for i in targetIndex:
    targetElements.append(element[i])

targetFamilyCode = []
#for i in targetIndex:
#    targetFamilyCode.append(element[i].Name)
for i in targetIndex: ##Stair 용도로만 사
    targetFamilyCode.append(element[i].GetParameterValueByName("Type").Name.split('_')[0])

WMforTargetElements = []
for i in targetIndex:
    WMforTargetElements.append(fullWMCodeDescriptionPerElement[i])

WMforTargetElements_flat = list(itertools.chain(*WMforTargetElements))
targetWMunique = findUnique(WMforTargetElements_flat)

resultDict = {
"TargetElements": targetElements,
"TargetFamilyCode": targetFamilyCode,
"WMforTargetElements": WMforTargetElements,
"TargetWMunique": targetWMunique
}



result = resultDict

# Assign your output to the OUT variable.
OUT = result
# ----------------------------------------

watch = Watch(select_target_family_element_and)
# note: Excel 정리 후 재검토 해야함
# 스틸 / 콘크리트 정리 및 확인 필요
code_block_3 = CodeBlock(i=select_target_family_element_and) { i; }

# group: Input Manager
value_for_import_from_others = CodeBlock(MainInput=code_block_3) { MainInput; RefInput1; RefInput2; }  # unwired: RefInput1, RefInput2

# group: <Func 1> Structural Concrete
code_block_4 = CodeBlock { "TargetElements"; }
valueAtKey = DesignScript.Builtin.Dictionary.ValueAtKey(dictionary=value_for_import_from_others.MainInput, key=code_block_4)
code_block_5 = CodeBlock { "M3"; }

firstItem = List.FirstItem(list=valueAtKey)

# group (continued): <Func 1> Structural Concrete
# note: <Func>
geometry = Element.Geometry(element=firstItem)
flatten = List.Flatten(list=geometry@L2)
volume = Solid.Volume(solid=flatten)
sum = Math.Sum(values=volume)
code_block_6 = CodeBlock(i=sum) { Math.Round(List.Flatten(i)/1000000000, 2); }
count = List.Count(list=code_block_6)
ofRepeatedItem = List.OfRepeatedItem(item=code_block_5, amount=count)
code_block_7 = CodeBlock(FuncValues=code_block_6, FuncValuesUnit=ofRepeatedItem)
# ---------- code_block_7.designscript (4 lines) ----------
{
"FuncValues": _FuncValues,
"FuncValuesUnit": _FuncValuesUnit
};
# ----------------------------------------

# group: Output Manager
reference_output = CodeBlock { ref; }  # unwired: ref
output = CodeBlock(MainOutput=code_block_7) { MainOutput; RefOutput_geoColor; }  # unwired: RefOutput_geoColor

watch_2 = Watch(code_block_7)

# group: Input Manager
value_for_import_from_others_2 = CodeBlock(MainInput=code_block_3) { MainInput; RefInput1; RefInput2; }  # unwired: RefInput1, RefInput2

# group: <Func 3> Superstructure Work Rebar Work
code_block_8 = CodeBlock { "TargetElements"; }
valueAtKey_2 = DesignScript.Builtin.Dictionary.ValueAtKey(dictionary=value_for_import_from_others_2.MainInput, key=code_block_8)
# note: <Func>
geometry_2 = Element.Geometry(element=valueAtKey_2)
flatten_2 = List.Flatten(list=geometry_2@L2)
volume_2 = Solid.Volume(solid=flatten_2)
flatten_3 = List.Flatten(list=volume_2)
sum_2 = Math.Sum(values=volume_2)
# note: 비율 추가
code_block_9 = CodeBlock(i=sum_2) { Math.Round(List.Flatten(i)/1000000000, 2); }
code_block_10 = CodeBlock { "TON"; }
sog_철근비 = DoubleInput(0)  # graph input
mul = code_block_9 * sog_철근비
code_block_11 = CodeBlock(i=mul) { Math.Round(List.Flatten(i)/1, 2); }
count_2 = List.Count(list=code_block_11)
ofRepeatedItem_2 = List.OfRepeatedItem(item=code_block_10, amount=count_2)
code_block_12 = CodeBlock(FuncValues=code_block_9, FuncValuesUnit=ofRepeatedItem_2)  # same code as code_block_7

# group: Input Manager
value_for_import_from_others_3 = CodeBlock(MainInput=code_block_3) { MainInput; RefInput1; RefInput2; }  # unwired: RefInput1, RefInput2

# group: <Func 2> Superstructure Work Form Work
# note: <Func>
code_block_13 = CodeBlock { "TargetElements"; }
valueAtKey_3 = DesignScript.Builtin.Dictionary.ValueAtKey(dictionary=value_for_import_from_others_3.MainInput, key=code_block_13)
code_block_14 = CodeBlock { "M2"; }

# group: Element Side 노드 수정
code_block_15 = CodeBlock(Element=valueAtKey_3) { _Element: var[]..[]; }
code_block_16 = CodeBlock(Element=code_block_15) { _Element; }
geometry_3 = Element.Geometry(element=code_block_16)
explode = Geometry.Explode(geometry=geometry_3)
code_block_17 = CodeBlock { 0.5; }
normalAtParameter = Surface.NormalAtParameter(surface=explode, u=code_block_17, v=code_block_17)
Z = Vector.Z(vector=normalAtParameter)
code_block_18 = CodeBlock { 0; }
round = Math.Round(number=Z, digits=code_block_18)
code_block_19 = CodeBlock(i=round) { i<1 && i>-1; }
filterByBoolMask = List.FilterByBoolMask(list=explode, mask=code_block_19)
color_palette = ColorPalette({R: 255, G: 0, B: 255, A: 136})
byGeometryColor = Modifiers.GeometryColor.ByGeometryColor(geometry=filterByBoolMask.in, color=color_palette)

# group: func2
code_block_20 = CodeBlock(Element=valueAtKey_3) { _Element: var[]..[]; }
code_block_21 = CodeBlock(Element=code_block_20) { _Element; }
code_block_22 = CodeBlock { 0.5; }
normalAtParameter_2 = Surface.NormalAtParameter(u=code_block_22, v=code_block_22)  # unwired: surface
code_block_23 = CodeBlock { 0; }
color_palette_2 = ColorPalette({R: 238, G: 232, B: 170, A: 128})

geometry_4 = Element.Geometry(element=code_block_21)
explode_2 = Geometry.Explode(geometry=geometry_4)

# group (continued): func2
function_apply = ApplyFunction(function=normalAtParameter_2, argument0=explode_2)
Z_2 = Vector.Z(vector=function_apply)
round_2 = Math.Round(number=Z_2, digits=code_block_23)
code_block_24 = CodeBlock(i=round_2) { i==-1; }
filterByBoolMask_2 = List.FilterByBoolMask(list=explode_2, mask=code_block_24)
byGeometryColor_2 = Modifiers.GeometryColor.ByGeometryColor(geometry=filterByBoolMask_2.out, color=color_palette_2)

# group: Input Manager
value_for_import_from_others_4 = CodeBlock(MainInput=code_block_3) { MainInput; RefInput1; RefInput2; }  # unwired: RefInput1, RefInput2

# group: <Func 4> Ceiling Painting
# note: 철골 / 콘크리트 분리코
code_block_25 = CodeBlock { "TargetElements"; }
valueAtKey_4 = DesignScript.Builtin.Dictionary.ValueAtKey(dictionary=value_for_import_from_others_4.MainInput, key=code_block_25)
geometry_5 = Element.Geometry(element=valueAtKey_4)
explode_3 = Geometry.Explode(geometry=geometry_5)
flatten_4 = List.Flatten(list=explode_3)
# note: <Func>
extractUpperFacesOfElement = Custom[ExtractUpperFacesOfElement](Element=valueAtKey_4)  # ExtractUpperFacesOfElement
flatten_5 = List.Flatten(list=extractUpperFacesOfElement.Surface)
byJoinedSurfaces = PolySurface.ByJoinedSurfaces(surfaces=flatten_5)
doesIntersect = Geometry.DoesIntersect(geometry=byJoinedSurfaces, other=flatten_4, lacing=CrossProduct)
filterByBoolMask_3 = List.FilterByBoolMask(list=flatten_4, mask=doesIntersect@L2)
flatten_6 = List.Flatten(list=filterByBoolMask_3.out)
area = Surface.Area(surface=flatten_6)
sum_3 = Math.Sum(values=area)
code_block_26 = CodeBlock(i=sum_3) { Math.Round(List.Flatten(i)/1000000, 2); }
code_block_27 = CodeBlock { "M2"; }
count_3 = List.Count(list=code_block_26)
ofRepeatedItem_3 = List.OfRepeatedItem(item=code_block_27, amount=count_3)
code_block_28 = CodeBlock(FuncValues=code_block_26, FuncValuesUnit=ofRepeatedItem_3)  # same code as code_block_7

watch_3 = Watch(code_block_28)

# group: Input Manager
value_for_import_from_others_5 = CodeBlock(MainInput=code_block_3) { MainInput; RefInput1; RefInput2; }  # unwired: RefInput1, RefInput2

# group: <Func 6,8> 계단과 벽체가 만나는 지점에서 Nosing을 잇는 선을 100mm offset하고 그 경계 하부 면적을 계산
code_block_29 = CodeBlock { "TargetElements"; }
# note: <Func>
valueAtKey_5 = DesignScript.Builtin.Dictionary.ValueAtKey(dictionary=value_for_import_from_others_5.MainInput, key=code_block_29)

geometry_6 = Element.Geometry(element=valueAtKey_5)
# note: <Func>
explode_4 = Geometry.Explode(geometry=geometry_6)
flatten_7 = List.Flatten(list=explode_4)

# group: func2
code_block_30 = CodeBlock(Element=valueAtKey_5) { _Element: var[]..[]; }
code_block_31 = CodeBlock(Element=code_block_30) { _Element; }
geometry_7 = Element.Geometry(element=code_block_31)
explode_5 = Geometry.Explode(geometry=geometry_7)
code_block_32 = CodeBlock { 0.5; }
normalAtParameter_3 = Surface.NormalAtParameter(u=code_block_32, v=code_block_32)  # unwired: surface
function_apply_2 = ApplyFunction(function=normalAtParameter_3, argument0=explode_5)
Z_3 = Vector.Z(vector=function_apply_2)
code_block_33 = CodeBlock { 0; }
round_3 = Math.Round(number=Z_3, digits=code_block_33)
code_block_34 = CodeBlock(i=round_3) { i==1; }
filterByBoolMask_4 = List.FilterByBoolMask(list=explode_5, mask=code_block_34)
color_palette_3 = ColorPalette({R: 238, G: 232, B: 170, A: 128})
byGeometryColor_3 = Modifiers.GeometryColor.ByGeometryColor(geometry=filterByBoolMask_4.in, color=color_palette_3)

flatten_8 = List.Flatten(list=filterByBoolMask_4.in)
byJoinedSurfaces_2 = PolySurface.ByJoinedSurfaces(surfaces=flatten_8)
doesIntersect_2 = Geometry.DoesIntersect(geometry=byJoinedSurfaces_2, other=flatten_7, lacing=CrossProduct)
filterByBoolMask_5 = List.FilterByBoolMask(list=flatten_7, mask=doesIntersect_2@L2)
perimeterCurves = Surface.PerimeterCurves(surface=filterByBoolMask_5.out@L1)
startPoint = Curve.StartPoint(curve=perimeterCurves)
boolean = BoolSelector(true)
byPoints = PolyCurve.ByPoints(points=startPoint, connectLastToFirst=boolean)
flatten_9 = List.Flatten(list=filterByBoolMask_5.out)
code_block_35 = CodeBlock { 450; }
translate = Geometry.Translate(geometry=flatten_9, zTranslation=code_block_35)
perimeterCurves_2 = Surface.PerimeterCurves(surface=translate)
startPoint_2 = Curve.StartPoint(curve=perimeterCurves_2)
boolean_2 = BoolSelector(true)
byPoints_2 = PolyCurve.ByPoints(points=startPoint_2, connectLastToFirst=boolean_2)
list_create = List.Create(item0=byPoints, item1=byPoints_2)
transpose = List.Transpose(lists=list_create)
byLoft = Solid.ByLoft(crossSections=transpose)
isNull = Object.IsNull(object=byLoft)
filterByBoolMask_6 = List.FilterByBoolMask(list=byLoft, mask=isNull)
byUnion = Solid.ByUnion(solids=filterByBoolMask_6.out)
geometry_8 = Element.Geometry(element=valueAtKey_5)
flatten_10 = List.Flatten(list=geometry_8)
byUnion_2 = Solid.ByUnion(solids=flatten_10)
differenceAll = Solid.DifferenceAll(solid=byUnion, others=byUnion_2)
explode_6 = Geometry.Explode(geometry=differenceAll)
code_block_36 = CodeBlock { 0.5; }
normalAtParameter_4 = Surface.NormalAtParameter(surface=explode_6, u=code_block_36, v=code_block_36)

# group: func2 (ExtractSideFacesOfElement)
Z_4 = Vector.Z(vector=normalAtParameter_4)
code_block_37 = CodeBlock { 0; }
round_4 = Math.Round(number=Z_4, digits=code_block_37)
code_block_38 = CodeBlock(i=round_4) { i<1 && i>-1; }
filterByBoolMask_7 = List.FilterByBoolMask(list=explode_6, mask=code_block_38)
color_palette_4 = ColorPalette({R: 255, G: 0, B: 255, A: 136})
byGeometryColor_4 = Modifiers.GeometryColor.ByGeometryColor(geometry=filterByBoolMask_7.in, color=color_palette_4)
code_block_39 = CodeBlock { Surface; }
code_block_40 = CodeBlock { GeometryColor; }

watch_4 = Watch(filterByBoolMask_2.in)
flatten_11 = List.Flatten(list=watch_4)
code_block_41 = CodeBlock(i=round_2) { i==1; }
filterByBoolMask_8 = List.FilterByBoolMask(list=explode_2, mask=code_block_41)
code_block_42 = CodeBlock { 0.5; }
pointAtParameter = Surface.PointAtParameter(surface=filterByBoolMask_8.in, u=code_block_42, v=code_block_42)
flatten_12 = List.Flatten(list=pointAtParameter)
Z_5 = Point.Z()  # unwired: point
sortByFunction = List.SortByFunction(list=flatten_12, sortFunction=Z_5)
byPoints_3 = PolyCurve.ByPoints(points=sortByFunction)
doesIntersect_3 = Geometry.DoesIntersect(geometry=flatten_11, other=byPoints_3)
filterByBoolMask_9 = List.FilterByBoolMask(list=flatten_11, mask=doesIntersect_3)
flatten_13 = List.Flatten(list=filterByBoolMask_9.out)

# group (continued): <Func 2> Superstructure Work Form Work
list_create_2 = List.Create(item0=filterByBoolMask.in, item1=flatten_13)
flatten_14 = List.Flatten(list=list_create_2@L3)
area_2 = Surface.Area(surface=flatten_14)
sum_4 = Math.Sum(values=area_2@L2)
code_block_43 = CodeBlock(i=sum_4) { Math.Round(List.Flatten(i)/1000000, 2); }
count_4 = List.Count(list=code_block_43)
ofRepeatedItem_4 = List.OfRepeatedItem(item=code_block_14, amount=count_4)
code_block_44 = CodeBlock(FuncValues=code_block_43, FuncValuesUnit=ofRepeatedItem_4)  # same code as code_block_7

watch_5 = Watch(code_block_44)

# group: Output Manager
reference_output_2 = CodeBlock { ref; }  # unwired: ref
output_2 = CodeBlock(MainOutput=watch_5) { MainOutput; RefOutput_geoColor; }  # unwired: RefOutput_geoColor

watch_6 = Watch(code_block_12)

# group: Output Manager
output_3 = CodeBlock(MainOutput=watch_6) { MainOutput; RefOutput_geoColor; }  # unwired: RefOutput_geoColor
reference_output_3 = CodeBlock(ref1=filterByBoolMask_2.in, ref2=filterByBoolMask_2.out) { ref1; ref2; }

# group: Output Manager
reference_output_4 = CodeBlock { ref; }  # unwired: ref
output_4 = CodeBlock { MainOutput; RefOutput_geoColor; }  # unwired: MainOutput, RefOutput_geoColor

# group: Output Manager
reference_output_5 = CodeBlock { ref; }  # unwired: ref
output_5 = CodeBlock { MainOutput; RefOutput_geoColor; }  # unwired: MainOutput, RefOutput_geoColor

# group: Output Manager
reference_output_6 = CodeBlock { ref; }  # unwired: ref
output_6 = CodeBlock { MainOutput; RefOutput_geoColor; }  # unwired: MainOutput, RefOutput_geoColor

Z_6 = Point.Z()  # unwired: point
sort = List.Sort(list=Z_6)
byStartPointEndPoint = Line.ByStartPointEndPoint()  # unwired: startPoint, endPoint
watch_7 = Watch(filterByBoolMask_7.out)
separate = Solid.Separate(solid=differenceAll)
doesIntersect_4 = Geometry.DoesIntersect(geometry=separate, other=watch_7, lacing=CrossProduct)
filterByBoolMask_10 = List.FilterByBoolMask(list=watch_7, mask=doesIntersect_4@L2)
watch_8 = Watch(filterByBoolMask_10.in)
area_3 = Surface.Area(surface=watch_8)
code_block_45 = CodeBlock { 0; }
round_5 = Math.Round(number=area_3, digits=code_block_45)
area_4 = Surface.Area()  # unwired: surface
minimumItemByKey = List.MinimumItemByKey(list=watch_8@L2, keyFunction=area_4)
watch_9 = Watch(minimumItemByKey)
area_5 = Surface.Area(surface=watch_9)
code_block_46 = CodeBlock { 0; }
round_6 = Math.Round(number=area_5, digits=code_block_46)
eq = round_5@L2 == round_6@L1  # lacing=Shortest
filterByBoolMask_11 = List.FilterByBoolMask(list=watch_8@L2, mask=eq@L2)
flatten_15 = List.Flatten(list=filterByBoolMask_11.in)
flatten_16 = List.Flatten(list=flatten_15)
countTrue = List.CountTrue(list=eq@L2)
code_block_47 = CodeBlock(a=countTrue) { a/2; }
code_block_48 = CodeBlock { 2; }
ofRepeatedItem_5 = List.OfRepeatedItem(item=code_block_47, amount=code_block_48)
transpose_2 = List.Transpose(lists=ofRepeatedItem_5)
flatten_17 = List.Flatten(list=transpose_2)
chop = List.Chop(list=flatten_16, lengths=flatten_17)
code_block_49 = CodeBlock { 0.5; }
pointAtParameter_2 = Surface.PointAtParameter(surface=chop, u=code_block_49, v=code_block_49)
Z_7 = Point.Z()  # unwired: point
sortByFunction_2 = List.SortByFunction(list=pointAtParameter_2@L2, sortFunction=Z_7)
byPoints_4 = PolyCurve.ByPoints(points=sortByFunction_2)
code_block_50 = CodeBlock { 200; }
extendStart = Curve.ExtendStart(curve=byPoints_4, distance=code_block_50)
startPoint_3 = Curve.StartPoint(curve=extendStart)
code_block_51 = CodeBlock { 2; }
chop_2 = List.Chop(list=startPoint_3, lengths=code_block_51)
extendEnd = Curve.ExtendEnd(curve=byPoints_4, distance=code_block_50)
endPoint = Curve.EndPoint(curve=extendEnd)
code_block_52 = CodeBlock { 2; }
chop_3 = List.Chop(list=endPoint, lengths=code_block_52)
addItemToFront = List.AddItemToFront(item=chop_2@L2, list=chop_3@L2)
flatten_18 = List.Flatten(list=addItemToFront@L3)
sortByFunction_3 = List.SortByFunction(list=flatten_18@L2, sortFunction=Z_6)
byPoints_5 = PolyCurve.ByPoints(points=sortByFunction_3)
code_block_53 = CodeBlock { 1200; }
translate_2 = Geometry.Translate(geometry=byPoints_5, zTranslation=code_block_53)
list_create_3 = List.Create(item0=byPoints_5, item1=translate_2)
transpose_3 = List.Transpose(lists=list_create_3)
watch_10 = Watch(filterByBoolMask_7.in)
separate_2 = Solid.Separate(solid=differenceAll)
doesIntersect_5 = Geometry.DoesIntersect(geometry=separate_2, other=watch_10, lacing=CrossProduct)
filterByBoolMask_12 = List.FilterByBoolMask(list=watch_10, mask=doesIntersect_5@L2)
watch_11 = Watch(filterByBoolMask_12.in)
doesIntersect_6 = Geometry.DoesIntersect(geometry=watch_11@L2, other=byPoints_5@L1)
filterByBoolMask_13 = List.FilterByBoolMask(list=watch_11, mask=doesIntersect_6)
watch_12 = Watch(filterByBoolMask_13.out)
byLoft_2 = Surface.ByLoft(crossSections=byPoints_4)
code_block_54 = CodeBlock { 300; }
thicken = Surface.Thicken(surface=byLoft_2, thickness=code_block_54)
doesIntersect_7 = Geometry.DoesIntersect(geometry=watch_12@L2, other=thicken@L1)
filterByBoolMask_14 = List.FilterByBoolMask(list=watch_12, mask=doesIntersect_7)
flatten_19 = List.Flatten(list=filterByBoolMask_14.out)

# group: Select Target Family Element And Connected WorkMasters
code_block_55 = CodeBlock { 2; }
select_target_family_element_and_2 = Python(IN[0]=set_up_all_element_inform_as, IN[1]=code_block_55)  # "Select Target Family Element And Connected WorkMasters"; CPython3; same code as select_target_family_element_and

watch_13 = Watch(select_target_family_element_and_2)

# group: Output Manager
output_7 = CodeBlock { MainOutput; RefOutput_geoColor; }  # unwired: MainOutput, RefOutput_geoColor
reference_output_7 = CodeBlock { ref; }  # unwired: ref

# group: Visual Manager
visual_켜기_끄기 = BoolSelector(false)
visual_manager = Python(IN[0]=output_7.RefOutput_geoColor, IN[1]=visual_켜기_끄기)  # CPython3
# ---------- visual_manager.python (18 lines) ----------
# Load the Python Standard and DesignScript Libraries
import sys
import clr
clr.AddReference('ProtoGeometry')
from Autodesk.DesignScript.Geometry import *

# The inputs to this node will be stored as a list in the IN variables.
dataEnteringNode = IN
geoColors = IN[0]
blnForVisual = IN[1]

# Place your code below this line
if blnForVisual == True:
    result = geoColors
else:
    result = 0
# Assign your output to the OUT variable.
OUT = result
# ----------------------------------------

# group: Output Manager
output_8 = CodeBlock { MainOutput; RefOutput_geoColor; }  # unwired: MainOutput, RefOutput_geoColor
reference_output_8 = CodeBlock { ref; }  # unwired: ref

# group: Visual Manager
visual_켜기_끄기_2 = BoolSelector(false)
visual_manager_2 = Python(IN[0]=output_8.RefOutput_geoColor, IN[1]=visual_켜기_끄기_2)  # CPython3; same code as visual_manager

code_block_56 = CodeBlock { i; }  # unwired: i

# group: Input Manager
value_for_import_from_others_6 = CodeBlock(MainInput=code_block_56) { MainInput; RefInput1; RefInput2; }  # unwired: RefInput1, RefInput2

# group: <Func 2> Superstructure Work Form Work
code_block_57 = CodeBlock { "TargetElements"; }
# note: <Func>
valueAtKey_6 = DesignScript.Builtin.Dictionary.ValueAtKey(dictionary=value_for_import_from_others_6.MainInput, key=code_block_57)

# group: Input Manager
value_for_import_from_others_7 = CodeBlock(MainInput=code_block_56) { MainInput; RefInput1; RefInput2; }  # unwired: RefInput1, RefInput2

# group: <Func 1>Structural Concrete
code_block_58 = CodeBlock { "TargetElements"; }
# note: <Func>
valueAtKey_7 = DesignScript.Builtin.Dictionary.ValueAtKey(dictionary=value_for_import_from_others_7.MainInput, key=code_block_58)

# group: Output Manager
output_9 = CodeBlock { MainOutput; RefOutput_geoColor; }  # unwired: MainOutput, RefOutput_geoColor
reference_output_9 = CodeBlock { ref; }  # unwired: ref

# group: Visual Manager
visual_켜기_끄기_3 = BoolSelector(false)
visual_manager_3 = Python(IN[0]=output_9.RefOutput_geoColor, IN[1]=visual_켜기_끄기_3)  # CPython3; same code as visual_manager

# group: Output Manager
output_10 = CodeBlock { MainOutput; RefOutput_geoColor; }  # unwired: MainOutput, RefOutput_geoColor
reference_output_10 = CodeBlock { ref; }  # unwired: ref

# group: Visual Manager
visual_켜기_끄기_4 = BoolSelector(false)
visual_manager_4 = Python(IN[0]=output_10.RefOutput_geoColor, IN[1]=visual_켜기_끄기_4)  # CPython3; same code as visual_manager

# group: Input Manager
value_for_import_from_others_8 = CodeBlock(MainInput=code_block_56) { MainInput; RefInput1; RefInput2; }  # unwired: RefInput1, RefInput2

# group: <Func 4> Ceiling Painting
code_block_59 = CodeBlock { "TargetElements"; }
# note: <Func>
valueAtKey_8 = DesignScript.Builtin.Dictionary.ValueAtKey(dictionary=value_for_import_from_others_8.MainInput, key=code_block_59)

# group: Input Manager
value_for_import_from_others_9 = CodeBlock(MainInput=code_block_56) { MainInput; RefInput1; RefInput2; }  # unwired: RefInput1, RefInput2

# group: <Func 3> Superstructure Work Rebar Work
code_block_60 = CodeBlock { "TargetElements"; }
# note: <Func>
valueAtKey_9 = DesignScript.Builtin.Dictionary.ValueAtKey(dictionary=value_for_import_from_others_9.MainInput, key=code_block_60)

# group: Output Manager
output_11 = CodeBlock { MainOutput; RefOutput_geoColor; }  # unwired: MainOutput, RefOutput_geoColor
reference_output_11 = CodeBlock { ref; }  # unwired: ref

# group: Visual Manager
visual_켜기_끄기_5 = BoolSelector(false)
visual_manager_5 = Python(IN[0]=output_11.RefOutput_geoColor, IN[1]=visual_켜기_끄기_5)  # CPython3; same code as visual_manager

# group: Output Manager
output_12 = CodeBlock { MainOutput; RefOutput_geoColor; }  # unwired: MainOutput, RefOutput_geoColor
reference_output_12 = CodeBlock { ref; }  # unwired: ref

# group: Visual Manager
visual_켜기_끄기_6 = BoolSelector(false)
visual_manager_6 = Python(IN[0]=output_12.RefOutput_geoColor, IN[1]=visual_켜기_끄기_6)  # CPython3; same code as visual_manager

# group: Input Manager
value_for_import_from_others_10 = CodeBlock(MainInput=code_block_56) { MainInput; RefInput1; RefInput2; }  # unwired: RefInput1, RefInput2

# group: <Func 6>Screed
code_block_61 = CodeBlock { "TargetElements"; }
# note: <Func>
valueAtKey_10 = DesignScript.Builtin.Dictionary.ValueAtKey(dictionary=value_for_import_from_others_10.MainInput, key=code_block_61)

# group: Input Manager
value_for_import_from_others_11 = CodeBlock(MainInput=code_block_56) { MainInput; RefInput1; RefInput2; }  # unwired: RefInput1, RefInput2

# group: <Func 5> Floor Painting
code_block_62 = CodeBlock { "TargetElements"; }
# note: <Func>
valueAtKey_11 = DesignScript.Builtin.Dictionary.ValueAtKey(dictionary=value_for_import_from_others_11.MainInput, key=code_block_62)

# group: Output Manager
output_13 = CodeBlock { MainOutput; RefOutput_geoColor; }  # unwired: MainOutput, RefOutput_geoColor
reference_output_13 = CodeBlock { ref; }  # unwired: ref

# group: Visual Manager
visual_켜기_끄기_7 = BoolSelector(false)
visual_manager_7 = Python(IN[0]=output_13.RefOutput_geoColor, IN[1]=visual_켜기_끄기_7)  # CPython3; same code as visual_manager

# group: Output Manager
output_14 = CodeBlock { MainOutput; RefOutput_geoColor; }  # unwired: MainOutput, RefOutput_geoColor
reference_output_14 = CodeBlock { ref; }  # unwired: ref

# group: Visual Manager
visual_켜기_끄기_8 = BoolSelector(false)
visual_manager_8 = Python(IN[0]=output_14.RefOutput_geoColor, IN[1]=visual_켜기_끄기_8)  # CPython3; same code as visual_manager

# group: Output Manager
output_15 = CodeBlock { MainOutput; RefOutput_geoColor; }  # unwired: MainOutput, RefOutput_geoColor
reference_output_15 = CodeBlock { ref; }  # unwired: ref

# group: Visual Manager
visual_켜기_끄기_9 = BoolSelector(false)
visual_manager_9 = Python(IN[0]=output_15.RefOutput_geoColor, IN[1]=visual_켜기_끄기_9)  # CPython3; same code as visual_manager

code_block_63 = CodeBlock { i; }  # unwired: i

# group: Input Manager
value_for_import_from_others_12 = CodeBlock(MainInput=code_block_63) { MainInput; RefInput1; RefInput2; }  # unwired: RefInput1, RefInput2

# group: <Func 4> Ceiling Painting
code_block_64 = CodeBlock { "TargetElements"; }
# note: <Func>
valueAtKey_12 = DesignScript.Builtin.Dictionary.ValueAtKey(dictionary=value_for_import_from_others_12.MainInput, key=code_block_64)

# group: Input Manager
value_for_import_from_others_13 = CodeBlock(MainInput=code_block_63) { MainInput; RefInput1; RefInput2; }  # unwired: RefInput1, RefInput2

# group: <Func 6>Skirt Painting
code_block_65 = CodeBlock { "TargetElements"; }
# note: <Func>
valueAtKey_13 = DesignScript.Builtin.Dictionary.ValueAtKey(dictionary=value_for_import_from_others_13.MainInput, key=code_block_65)

# group: Input Manager
value_for_import_from_others_14 = CodeBlock(MainInput=code_block_63) { MainInput; RefInput1; RefInput2; }  # unwired: RefInput1, RefInput2

# group: <Func 5> Floor Painting
code_block_66 = CodeBlock { "TargetElements"; }
# note: <Func>
valueAtKey_14 = DesignScript.Builtin.Dictionary.ValueAtKey(dictionary=value_for_import_from_others_14.MainInput, key=code_block_66)

# group: Output Manager
output_16 = CodeBlock { MainOutput; RefOutput_geoColor; }  # unwired: MainOutput, RefOutput_geoColor
reference_output_16 = CodeBlock { ref; }  # unwired: ref

# group: Visual Manager
visual_켜기_끄기_10 = BoolSelector(false)
visual_manager_10 = Python(IN[0]=output_16.RefOutput_geoColor, IN[1]=visual_켜기_끄기_10)  # CPython3; same code as visual_manager

# group: Input Manager
value_for_import_from_others_15 = CodeBlock(MainInput=code_block_63) { MainInput; RefInput1; RefInput2; }  # unwired: RefInput1, RefInput2

# group: <Func 2> Superstructure Work Form Work
code_block_67 = CodeBlock { "TargetElements"; }
# note: <Func>
valueAtKey_15 = DesignScript.Builtin.Dictionary.ValueAtKey(dictionary=value_for_import_from_others_15.MainInput, key=code_block_67)

# group: Output Manager
output_17 = CodeBlock { MainOutput; RefOutput_geoColor; }  # unwired: MainOutput, RefOutput_geoColor
reference_output_17 = CodeBlock { ref; }  # unwired: ref

# group: Visual Manager
visual_켜기_끄기_11 = BoolSelector(false)
visual_manager_11 = Python(IN[0]=output_17.RefOutput_geoColor, IN[1]=visual_켜기_끄기_11)  # CPython3; same code as visual_manager

# group: Input Manager
value_for_import_from_others_16 = CodeBlock(MainInput=code_block_63) { MainInput; RefInput1; RefInput2; }  # unwired: RefInput1, RefInput2

# group: <Func 3> Superstructure Work Rebar Work
code_block_68 = CodeBlock { "TargetElements"; }
# note: <Func>
valueAtKey_16 = DesignScript.Builtin.Dictionary.ValueAtKey(dictionary=value_for_import_from_others_16.MainInput, key=code_block_68)

# group: Output Manager
output_18 = CodeBlock { MainOutput; RefOutput_geoColor; }  # unwired: MainOutput, RefOutput_geoColor
reference_output_18 = CodeBlock { ref; }  # unwired: ref

# group: Visual Manager
visual_켜기_끄기_12 = BoolSelector(false)
visual_manager_12 = Python(IN[0]=output_18.RefOutput_geoColor, IN[1]=visual_켜기_끄기_12)  # CPython3; same code as visual_manager

# group: Input Manager
value_for_import_from_others_17 = CodeBlock(MainInput=code_block_63) { MainInput; RefInput1; RefInput2; }  # unwired: RefInput1, RefInput2

# group: <Func 1>Structural Concrete
code_block_69 = CodeBlock { "TargetElements"; }
# note: <Func>
valueAtKey_17 = DesignScript.Builtin.Dictionary.ValueAtKey(dictionary=value_for_import_from_others_17.MainInput, key=code_block_69)

# group: Output Manager
output_19 = CodeBlock { MainOutput; RefOutput_geoColor; }  # unwired: MainOutput, RefOutput_geoColor
reference_output_19 = CodeBlock { ref; }  # unwired: ref

# group: Visual Manager
visual_켜기_끄기_13 = BoolSelector(false)
visual_manager_13 = Python(IN[0]=output_19.RefOutput_geoColor, IN[1]=visual_켜기_끄기_13)  # CPython3; same code as visual_manager

# group: Input Manager
value_for_import_from_others_18 = CodeBlock(MainInput=code_block_63) { MainInput; RefInput1; RefInput2; }  # unwired: RefInput1, RefInput2

# group: <Func 7>Screed
code_block_70 = CodeBlock { "TargetElements"; }
# note: <Func>
valueAtKey_18 = DesignScript.Builtin.Dictionary.ValueAtKey(dictionary=value_for_import_from_others_18.MainInput, key=code_block_70)

countTrue_2 = List.CountTrue(list=code_block_24@L2)
color_palette_5 = ColorPalette({R: 238, G: 232, B: 170, A: 128})
byGeometryColor_5 = Modifiers.GeometryColor.ByGeometryColor(geometry=flatten_14, color=color_palette_5)

# group: Input Manager
value_for_import_from_others_19 = CodeBlock(MainInput=code_block_3) { MainInput; RefInput1; RefInput2; }  # unwired: RefInput1, RefInput2

# group: <Func 5> Flooring
code_block_71 = CodeBlock { "TargetElements"; }
valueAtKey_19 = DesignScript.Builtin.Dictionary.ValueAtKey(dictionary=value_for_import_from_others_19.MainInput, key=code_block_71)
geometry_9 = Element.Geometry(element=valueAtKey_19)
explode_7 = Geometry.Explode(geometry=geometry_9)
flatten_20 = List.Flatten(list=explode_7)
# note: <Func>
extractUpperFacesOfElement_2 = Custom[ExtractUpperFacesOfElement](Element=valueAtKey_19)
flatten_21 = List.Flatten(list=extractUpperFacesOfElement_2.Surface)
byJoinedSurfaces_3 = PolySurface.ByJoinedSurfaces(surfaces=flatten_21)
doesIntersect_8 = Geometry.DoesIntersect(geometry=byJoinedSurfaces_3, other=flatten_20, lacing=CrossProduct)
filterByBoolMask_15 = List.FilterByBoolMask(list=flatten_20, mask=doesIntersect_8@L2)
flatten_22 = List.Flatten(list=filterByBoolMask_15.in)
flatten_23 = List.Flatten(list=filterByBoolMask_15.out)
byJoinedSurfaces_4 = PolySurface.ByJoinedSurfaces(surfaces=flatten_23)
doesIntersect_9 = Geometry.DoesIntersect(geometry=flatten_22, other=byJoinedSurfaces_4, lacing=CrossProduct)
filterByBoolMask_16 = List.FilterByBoolMask(list=flatten_22, mask=doesIntersect_9@L2)
flatten_24 = List.Flatten(list=filterByBoolMask_16.out)
area_6 = Surface.Area(surface=flatten_24)
sum_5 = Math.Sum(values=area_6)
code_block_72 = CodeBlock(i=sum_5) { Math.Round(List.Flatten(i)/1000000, 2); }
code_block_73 = CodeBlock { "M2"; }
count_5 = List.Count(list=code_block_72)
ofRepeatedItem_6 = List.OfRepeatedItem(item=code_block_73, amount=count_5)
code_block_74 = CodeBlock(FuncValues=code_block_72, FuncValuesUnit=ofRepeatedItem_6)  # same code as code_block_7
watch_14 = Watch(code_block_74)

categories_2 = Categories("OST_StairsRuns")
all_elements_of_category_2 = ElementsOfCategory(Category=categories_2)
geometry_10 = Element.Geometry(element=all_elements_of_category_2)
categories_3 = Categories("OST_StairsLandings")
all_elements_of_category_3 = ElementsOfCategory(Category=categories_3)
geometry_11 = Element.Geometry(element=all_elements_of_category_3)

# group: Input Manager
value_for_import_from_others_20 = CodeBlock(MainInput=code_block_3, RefInput1=reference_output_3.ref1, RefInput2=reference_output_3.ref2) { MainInput; RefInput1; RefInput2; }

# group: <Func 6> Flooring / Screed
flatten_25 = List.Flatten(list=value_for_import_from_others_20.RefInput2)
count_6 = List.Count(list=value_for_import_from_others_20.RefInput1@L2)
code_block_75 = CodeBlock(a=count_6) { a>5; }
filterByBoolMask_17 = List.FilterByBoolMask(list=value_for_import_from_others_20.RefInput1@L3, mask=code_block_75)
flatten_26 = List.Flatten(list=filterByBoolMask_17.out)
byJoinedSurfaces_5 = PolySurface.ByJoinedSurfaces(surfaces=flatten_26)
doesIntersect_10 = Geometry.DoesIntersect(geometry=byJoinedSurfaces_5, other=flatten_25)
filterByBoolMask_18 = List.FilterByBoolMask(list=flatten_25, mask=doesIntersect_10)
area_7 = Surface.Area(surface=filterByBoolMask_18.out)
sum_6 = Math.Sum(values=area_7)
code_block_76 = CodeBlock(i=sum_6) { Math.Round(List.Flatten(i)/1000000, 2); }
code_block_77 = CodeBlock { "M2"; }
count_7 = List.Count(list=code_block_76)
ofRepeatedItem_7 = List.OfRepeatedItem(item=code_block_77, amount=count_7)
code_block_78 = CodeBlock(FuncValues=code_block_76, FuncValuesUnit=ofRepeatedItem_7)  # same code as code_block_7
watch_15 = Watch(code_block_78)
watch_16 = Watch(filterByBoolMask_18.out)

# group: Output Manager
reference_output_20 = CodeBlock { ref; }  # unwired: ref
output_20 = CodeBlock(MainOutput=watch_15, RefOutput_geoColor=filterByBoolMask_18.out) { MainOutput; RefOutput_geoColor; }

color_palette_6 = ColorPalette({R: 238, G: 232, B: 170, A: 128})
byGeometryColor_6 = Modifiers.GeometryColor.ByGeometryColor(geometry=output_20.RefOutput_geoColor, color=color_palette_6)

# group: Output Manager
reference_output_21 = CodeBlock { ref; }  # unwired: ref
output_21 = CodeBlock { MainOutput; RefOutput_geoColor; }  # unwired: MainOutput, RefOutput_geoColor

# group: Visual Manager
visual_켜기_끄기_14 = BoolSelector(false)
visual_manager_14 = Python(IN[0]=output_21.RefOutput_geoColor, IN[1]=visual_켜기_끄기_14)  # CPython3; same code as visual_manager

code_block_79 = CodeBlock { "M2"; }

# group: Select Target Family Element And Connected WorkMasters
code_block_80 = CodeBlock { 1; }
select_target_family_element_and_3 = Python(IN[0]=set_up_all_element_inform_as, IN[1]=code_block_80)  # "Select Target Family Element And Connected WorkMasters"; CPython3; same code as select_target_family_element_and

watch_17 = Watch(select_target_family_element_and_3)
family_types = FamilyTypes("Steel-Channel-Beam_R2:BM126_C-150×75x6.5x10")  # graph input
code_block_81 = CodeBlock { "SteelWeight"; }
getParameterValueByName = Element.GetParameterValueByName(element=family_types, parameterName=code_block_81)

# group: Heavy, Medium, Light WM 판별
code_block_82 = CodeBlock(i=watch_17) { i["WMforTargetElements"]; }
flatten_27 = List.Flatten(list=code_block_82)
code_block_83 = CodeBlock { ["Heavy", "Medium", "Light"]; }
contains = String.Contains(string=flatten_27, searchFor=code_block_83, lacing=CrossProduct)
anyTrue = List.AnyTrue(list=contains@L2)
boolean_3 = BoolSelector(true)
allIndicesOf = List.AllIndicesOf(list=anyTrue, item=boolean_3)
removeItemAtIndex = List.RemoveItemAtIndex(list=flatten_27, indices=allIndicesOf)
getItemAtIndex = List.GetItemAtIndex(list=flatten_27, index=allIndicesOf)
code_block_84 = CodeBlock(steeltype=getParameterValueByName) { steeltype; }
contains_2 = String.Contains(string=getItemAtIndex, searchFor=code_block_84, lacing=CrossProduct)
boolean_4 = BoolSelector(true)
allIndicesOf_2 = List.AllIndicesOf(list=contains_2, item=boolean_4)
getItemAtIndex_2 = List.GetItemAtIndex(list=getItemAtIndex, index=allIndicesOf_2)
join = List.Join(list0=removeItemAtIndex, list1=getItemAtIndex_2)

watch_18 = Watch(join)

# group: Output Manager
output_22 = CodeBlock { MainOutput; RefOutput_geoColor; }  # unwired: MainOutput, RefOutput_geoColor
reference_output_22 = CodeBlock { ref; }  # unwired: ref

# group: Visual Manager
visual_켜기_끄기_15 = BoolSelector(false)
visual_manager_15 = Python(IN[0]=output_22.RefOutput_geoColor, IN[1]=visual_켜기_끄기_15)  # CPython3; same code as visual_manager

# group: Output Manager
output_23 = CodeBlock { MainOutput; RefOutput_geoColor; }  # unwired: MainOutput, RefOutput_geoColor
reference_output_23 = CodeBlock { ref; }  # unwired: ref

# group: Visual Manager
visual_켜기_끄기_16 = BoolSelector(false)
visual_manager_16 = Python(IN[0]=output_23.RefOutput_geoColor, IN[1]=visual_켜기_끄기_16)  # CPython3; same code as visual_manager

# group: Output Manager
output_24 = CodeBlock { MainOutput; RefOutput_geoColor; }  # unwired: MainOutput, RefOutput_geoColor
reference_output_24 = CodeBlock { ref; }  # unwired: ref

# group: Visual Manager
visual_켜기_끄기_17 = BoolSelector(false)
visual_manager_17 = Python(IN[0]=output_24.RefOutput_geoColor, IN[1]=visual_켜기_끄기_17)  # CPython3; same code as visual_manager

# group: Output Manager
output_25 = CodeBlock { MainOutput; RefOutput_geoColor; }  # unwired: MainOutput, RefOutput_geoColor
reference_output_25 = CodeBlock { ref; }  # unwired: ref

# group: Visual Manager
visual_켜기_끄기_18 = BoolSelector(false)
visual_manager_18 = Python(IN[0]=output_25.RefOutput_geoColor, IN[1]=visual_켜기_끄기_18)  # CPython3; same code as visual_manager

code_block_85 = CodeBlock(i=select_target_family_element_and_3) { i; }

# group: Input Manager
value_for_import_from_others_21 = CodeBlock(MainInput=code_block_85) { MainInput; RefInput1; RefInput2; }  # unwired: RefInput1, RefInput2

# group: <Func 0> Stee; Weight
categories_4 = Categories("OST_StairsRuns")
all_elements_of_category_4 = ElementsOfCategory(Category=categories_4)
geometry_12 = Element.Geometry(element=all_elements_of_category_4)
flatten_28 = List.Flatten(list=geometry_12)
categories_5 = Categories("OST_StairsLandings")
all_elements_of_category_5 = ElementsOfCategory(Category=categories_5)
geometry_13 = Element.Geometry(element=all_elements_of_category_5)
flatten_29 = List.Flatten(list=geometry_13)
join_2 = List.Join(list0=flatten_28, list1=flatten_29)
byUnion_3 = Solid.ByUnion(solids=join_2)
code_block_86 = CodeBlock { "TargetElements"; }
valueAtKey_20 = DesignScript.Builtin.Dictionary.ValueAtKey(dictionary=value_for_import_from_others_21.MainInput, key=code_block_86)
geometry_14 = Element.Geometry(element=valueAtKey_20)
byUnion_4 = Solid.ByUnion(solids=geometry_14)
intersect = Geometry.Intersect(geometry=byUnion_3, other=byUnion_4)
explode_8 = Geometry.Explode(geometry=intersect)
flatten_30 = List.Flatten(list=explode_8)
code_block_87 = CodeBlock { 0.5; }
normalAtParameter_5 = Surface.NormalAtParameter(surface=explode_8, u=code_block_87, v=code_block_87)
Z_8 = Vector.Z(vector=normalAtParameter_5)
code_block_88 = CodeBlock { 2; }
round_7 = Math.Round(number=Z_8, digits=code_block_88)
watch_19 = Watch(round_7)
flatten_31 = List.Flatten(list=watch_19)
code_block_89 = CodeBlock { 0; }
eq_2 = flatten_31 == code_block_89
filterByBoolMask_19 = List.FilterByBoolMask(list=flatten_30, mask=eq_2)
flatten_32 = List.Flatten(list=filterByBoolMask_19.out)
area_8 = Surface.Area(surface=flatten_32)
sum_7 = Math.Sum(values=area_8)
elementType = Element.ElementType(element=valueAtKey_20)
code_block_90 = CodeBlock { "Minimum Run Width"; }
getParameterValueByName_2 = Element.GetParameterValueByName(element=elementType, parameterName=code_block_90)
code_block_91 = CodeBlock(area=sum_7, 계단너비=getParameterValueByName_2) { Math.Round(area/계단너비/1000,2); }
code_block_92 = CodeBlock { "Mass per Unit Length"; }
getParameterValueByName_3 = Element.GetParameterValueByName(element=family_types, parameterName=code_block_92)
# note: <Func>
code_block_93 = CodeBlock(길이=code_block_91, a=getParameterValueByName_3) { Math.Round(길이*a/1000,2); }
code_block_94 = CodeBlock { "Ton"; }

# group: Output Manager
output_26 = CodeBlock { MainOutput; RefOutput_geoColor; }  # unwired: MainOutput, RefOutput_geoColor
reference_output_26 = CodeBlock(ref=code_block_91, ref2=code_block_93, ref3=sum_7) { ref; ref2; ref3; }

# group: Visual Manager
visual_켜기_끄기_19 = BoolSelector(false)
visual_manager_19 = Python(IN[0]=output_26.RefOutput_geoColor, IN[1]=visual_켜기_끄기_19)  # CPython3; same code as visual_manager

# group: Input Manager
value_for_import_from_others_22 = CodeBlock(MainInput=code_block_85, RefInput1=reference_output_26.ref2) { MainInput; RefInput1; RefInput2; }  # unwired: RefInput2

# group: <Func 0> Stee; Weight
code_block_95 = CodeBlock { "TargetElements"; }
# note: <Func>
valueAtKey_21 = DesignScript.Builtin.Dictionary.ValueAtKey(dictionary=value_for_import_from_others_22.MainInput, key=code_block_95)

# group: Input Manager
value_for_import_from_others_23 = CodeBlock(MainInput=code_block_85, RefInput1=reference_output_26.ref2) { MainInput; RefInput1; RefInput2; }  # unwired: RefInput2

# group: <Func 0>Gusset, Stiffener
number = DoubleInput(0.2)  # graph input
code_block_96 = CodeBlock(Ton=value_for_import_from_others_23.RefInput1, Ratio=number) { Ton*Ratio; }
# note: <Func>
code_block_97 = CodeBlock { "Ton"; }

count_8 = List.Count(list=code_block_96)
ofRepeatedItem_8 = List.OfRepeatedItem(item=code_block_97, amount=count_8)
code_block_98 = CodeBlock(FuncValues=code_block_96, FuncValuesUnit=ofRepeatedItem_8)  # same code as code_block_7
watch_20 = Watch(code_block_98)

# group: Input Manager
value_for_import_from_others_24 = CodeBlock(MainInput=code_block_85, RefInput1=reference_output_26.ref, RefInput2=family_types) { MainInput; RefInput1; RefInput2; }

# group: <Func 0>Steel Painting
code_block_99 = CodeBlock { "Mass per Unit Length"; }
getParameterValueByName_4 = Element.GetParameterValueByName(element=value_for_import_from_others_24.RefInput2, parameterName=code_block_99)
# note: <Func>
code_block_100 = CodeBlock(길이=value_for_import_from_others_24.RefInput1, b=getParameterValueByName_4) { Math.Round(길이*b,2); }

code_block_101 = CodeBlock { "M2"; }
count_9 = List.Count(list=code_block_100)
ofRepeatedItem_9 = List.OfRepeatedItem(item=code_block_101, amount=count_9)
code_block_102 = CodeBlock(FuncValues=code_block_100, FuncValuesUnit=ofRepeatedItem_9)  # same code as code_block_7
watch_21 = Watch(code_block_102)

# group: Input Manager
value_for_import_from_others_25 = CodeBlock(MainInput=code_block_85, RefInput1=reference_output_26.ref2) { MainInput; RefInput1; RefInput2; }  # unwired: RefInput2

# group: <Func 0> Bolts&Nuts
number_2 = DoubleInput(0.03)  # graph input
code_block_103 = CodeBlock(Ton=value_for_import_from_others_25.RefInput1, Ratio=number_2) { Ton*Ratio; }
# note: <Func>
code_block_104 = CodeBlock { "Ton"; }

count_10 = List.Count(list=code_block_103)
ofRepeatedItem_10 = List.OfRepeatedItem(item=code_block_104, amount=count_10)
code_block_105 = CodeBlock(FuncValues=code_block_103, FuncValuesUnit=ofRepeatedItem_10)  # same code as code_block_7
watch_22 = Watch(code_block_105)

# group: Input Manager
value_for_import_from_others_26 = CodeBlock(MainInput=code_block_85, RefInput1=reference_output_26.ref3) { MainInput; RefInput1; RefInput2; }  # unwired: RefInput2

# group: <Func 0> Grating
code_block_106 = CodeBlock(area=value_for_import_from_others_26.RefInput1) { Math.Round(area/2/1000000,2); }
# note: <Func>
code_block_107 = CodeBlock { "M2"; }

count_11 = List.Count(list=code_block_106)
ofRepeatedItem_11 = List.OfRepeatedItem(item=code_block_107, amount=count_11)
code_block_108 = CodeBlock(FuncValues=code_block_106, FuncValuesUnit=ofRepeatedItem_11)  # same code as code_block_7
watch_23 = Watch(code_block_108)

# group: Output Manager
output_27 = CodeBlock { MainOutput; RefOutput_geoColor; }  # unwired: MainOutput, RefOutput_geoColor
reference_output_27 = CodeBlock { ref; }  # unwired: ref

# group: Visual Manager
visual_켜기_끄기_20 = BoolSelector(false)
visual_manager_20 = Python(IN[0]=output_27.RefOutput_geoColor, IN[1]=visual_켜기_끄기_20)  # CPython3; same code as visual_manager

# group: Input Manager
value_for_import_from_others_27 = CodeBlock(MainInput=code_block_85, RefInput1=reference_output_26.ref, RefInput2=family_types) { MainInput; RefInput1; RefInput2; }

# group: <Func 0>Steel Painting
code_block_109 = CodeBlock { "Mass per Unit Length"; }
getParameterValueByName_5 = Element.GetParameterValueByName(element=value_for_import_from_others_27.RefInput2, parameterName=code_block_109)
# note: <Func>
code_block_110 = CodeBlock(길이=value_for_import_from_others_27.RefInput1, b=getParameterValueByName_5) { Math.Round(길이*b,2); }

code_block_111 = CodeBlock { "M2"; }
count_12 = List.Count(list=code_block_110)
ofRepeatedItem_12 = List.OfRepeatedItem(item=code_block_111, amount=count_12)
code_block_112 = CodeBlock(FuncValues=code_block_110, FuncValuesUnit=ofRepeatedItem_12)  # same code as code_block_7
watch_24 = Watch(code_block_112)
code_block_113 = CodeBlock { "M2"; }
count_13 = List.Count(list=code_block_93)
ofRepeatedItem_13 = List.OfRepeatedItem(item=code_block_94, amount=count_13)
code_block_114 = CodeBlock(FuncValues=code_block_93, FuncValuesUnit=ofRepeatedItem_13)  # same code as code_block_7
watch_25 = Watch(code_block_114)
code_block_115 = CodeBlock { "Ton"; }
count_14 = List.Count(list=value_for_import_from_others_22.RefInput1)
ofRepeatedItem_14 = List.OfRepeatedItem(item=code_block_115, amount=count_14)
code_block_116 = CodeBlock(FuncValues=value_for_import_from_others_22.RefInput1, FuncValuesUnit=ofRepeatedItem_14)  # same code as code_block_7
watch_26 = Watch(code_block_116)
