# Dynamo graph 03 Str Column (1224).dyn (Dynamo 2.12.0.5650)

# group: Primary Input : Excel & Revit Elements
categories = Categories("OST_StructuralColumns")
all_elements_of_category = ElementsOfCategory(Category=categories)
string_from_web = Python()  # CPython3; unwired: IN[0]
# ---------- string_from_web.python (19 lines) ----------
# Load the Python Standard and DesignScript Libraries
import sys
import clr
clr.AddReference('ProtoGeometry')
from Autodesk.DesignScript.Geometry import *
import urllib.request

# The inputs to this node will be stored as a list in the IN variables.
dataEnteringNode = IN
inputURL = "https://raw.githubusercontent.com/HNANmal/mQ/master/Hdynlib/General/ImportExcel.py"

# Place your code below this line
req = urllib.request
data = req.urlopen(inputURL)

result = data.read().decode("utf-8")

# Assign your output to the OUT variable.
OUT = result
# ----------------------------------------
file_path = Filename(".\DMS(Data Matching Schedule)_R0(Seq.1)(2).xlsx")  # graph input
sheet_name = CodeBlock { "Str Columns"; }
github_python_import_excel_by = PythonStringNode(script=string_from_web, IN[0]=file_path, IN[1]=sheet_name)  # "Github_Python@Import Excel(By OpenpyXl)"; CPython3
code_block = CodeBlock(InputElement=all_elements_of_category, InputData=github_python_import_excel_by) { _InputElement; _InputData; }

# group: GetFull WMCodeDescription PerElement
excelDataManagerNode = Python(IN[0]=code_block._InputElement, IN[1]=code_block._InputData)  # CPython3
# ---------- excelDataManagerNode.python (279 lines) ----------
# Load the Python Standard and DesignScript Libraries
import os
import sys
sys.path.append(os.getenv('LOCALAPPDATA').replace('\\','\\\\') + r'\Programs\Python\Python39\Lib\site-packages')
import clr
clr.AddReference('RevitAPI')
import Autodesk

clr.AddReference('ProtoGeometry')
from Autodesk.DesignScript.Geometry import *

clr.AddReference('RevitNodes')
import Revit
clr.ImportExtensions(Revit.Elements)

clr.ImportExtensions(Revit.GeometryConversion)
clr.ImportExtensions(Revit.GeometryReferences)

clr.AddReference('RevitServices')
import RevitServices
from RevitServices.Persistence import DocumentManager
from RevitServices.Transactions import TransactionManager

doc = DocumentManager.Instance.CurrentDBDocument

import random
import itertools
from functools import reduce
from collections import Iterable
import datetime
import openpyxl

def iterable(obj):
    return isinstance(obj, Iterable)

def findUnique(inputs):
    result = []
    for i in inputs:
        if i in result:
            pass
        else:
            result.append(i)
    return result

# The inputs to this node will be stored as a list in the IN variables.
dataEnteringNode = IN
inputElements = IN[0]
inputData = IN[1]
#inputSheetName = IN[2]

def importExcel(path, SheetNameIn):
    wb_obj = openpyxl.load_workbook(str(path), data_only=True)
    sheet_obj = wb_obj.get_sheet_by_name(str(SheetNameIn))

    m_row = sheet_obj.max_row
    m_col = sheet_obj.max_column

    listOut = []

    for i in range(1, m_row +1):
        listTemp = []
        for j in range(1, m_col + 1):
            cell_obj = sheet_obj.cell(row=i, column=j)
            listTemp.append(cell_obj.value)
            if len(listTemp) == m_col:
                listOut.append(listTemp)
    return listOut

def getUsedFamilyTypeOfModeling(elements):
    familyCode = list(map(lambda x: x.Name.split('_')[0], elements))
    unq_familyCode = findUnique(familyCode)
    return unq_familyCode
    
def createExcelDataDictionary(values):
    result = {}
    for i in range(len(values)):
        result[str(i)] = values[i]
    return result

def findTargetIndex(targets, list):
    result = []
    for target in targets:
        for i in range(len(list)):
            if target in str(list[i]):
                result.append(i)
            else:
                pass
    result.sort()
    return result
    
def GetValueAtKeys(keys, dictionary):
    result = [] 
    for i in keys:
        result.append(dictionary[str(i)])
    return result


# Place your code below this line
usedFamilyTypeOfModeling = getUsedFamilyTypeOfModeling(inputElements)
excelWholeDataSet = inputData#importExcel(inputFilePath, inputSheetName)
trExcelWholeDataSet = list(zip(*excelWholeDataSet))
excelColumnDataSet = createExcelDataDictionary(trExcelWholeDataSet)
excelRowDataSet = createExcelDataDictionary(excelWholeDataSet)
ColumnIndexOfUsedFamilyType = findTargetIndex(usedFamilyTypeOfModeling, trExcelWholeDataSet)
ColDataSetOfUsedFamilyType = GetValueAtKeys(ColumnIndexOfUsedFamilyType, excelColumnDataSet)
materialPerElementFromModeling = []
for i in inputElements:
    materialPerElementFromModeling.append(i.GetMaterials())
#list(map(lambda x: x.GetMaterials, inputElements)) "맵함수로 처리하면 리스트화 할 때 타입 변환 오류 남"

targetWMRowIndex = []
for i in ColDataSetOfUsedFamilyType:
    targetWMRowIndex.append(findTargetIndex(['000'], i))

rowDataSetOfUsedWM = []
for i in targetWMRowIndex:
    rowDataSetOfUsedWM.append(GetValueAtKeys(i, excelRowDataSet))

workGroup = []
for i in rowDataSetOfUsedWM:
    tmp = []
    for j in i:
        tmp.append(j[0])
    workGroup.append(tmp)
    
workMaster = []
for i in range(len(ColDataSetOfUsedFamilyType)):
    tmp=[]
    for k in targetWMRowIndex[i]:
        tmp.append(ColDataSetOfUsedFamilyType[i][k])
    workMaster.append(tmp)

matchedWM = []
for i in range(len(workGroup)):
    tmp = []
    for j in range(len(workGroup[i])):
        fullWM = workGroup[i][j] +"-"+ workMaster[i][j]
        tmp.append(fullWM)
    matchedWM.append(tmp)

matchedWorkGruopAndMasterCode = []
for i in matchedWM:
    if len(i) > 0:
        matchedWorkGruopAndMasterCode.append(i)
    else:
        pass

matchedWMDescription = []
for i in rowDataSetOfUsedWM:
    tmp=[]
    for j in i:
        tmp.append(j[1] +" "+ j[2] +" "+ j[3] +" "+ "("+ j[4] +")")
    if len(tmp) > 0:
        matchedWMDescription.append(tmp)
    else:
        pass

matchedWMUnit = []
for i in rowDataSetOfUsedWM:
    tmp=[]
    for j in i:
        tmp.append(j[4])
    if len(tmp) > 0:
        matchedWMUnit.append(tmp)
    else:
        pass

matchedWorkGruopAndMasterCode_flat = list(itertools.chain(*matchedWorkGruopAndMasterCode))
matchedWMDescription_flat = list(itertools.chain(*matchedWMDescription))

dic_WMandDescription_Excel = {}
for i in range(len(matchedWorkGruopAndMasterCode_flat)):
    dic_WMandDescription_Excel[matchedWorkGruopAndMasterCode_flat[i]] = matchedWMDescription_flat[i]

usedFamilyTypeInExcelOrder = list(map(lambda x: x[3], ColDataSetOfUsedFamilyType))
usedFamilyCodeInExcelOrder = findUnique(list(map(lambda x: x.split('_')[0], usedFamilyTypeInExcelOrder)))

dic_FamilyCodeandWM = {}
for i in range(len(usedFamilyCodeInExcelOrder)):
    dic_FamilyCodeandWM[usedFamilyCodeInExcelOrder[i]] = matchedWorkGruopAndMasterCode[i]

workMasterCodePerElement = []
familyCodePerElem = list(map(lambda x: x.Name.split('_')[0], inputElements))
for i in familyCodePerElem:
    workMasterCodePerElement.append(dic_FamilyCodeandWM[i])

materialNamePerElem = []
for i in materialPerElementFromModeling:
    tmp = []
    for j in i:
        tmp.append(j.Name)
    materialNamePerElem.append(tmp)

WMPerElementFromModeling = []
for i in materialNamePerElem:
    tmp = []
    for j in i:
        tmp.append(j.split('_')[0])
    WMPerElementFromModeling.append(tmp)

specPerElementFromModeling = []
for i in materialNamePerElem:
    tmp = []
    for j in i:
        a = j.split('_')
        del a[0]
        b = " ".join(a)
        tmp.append(b)
    specPerElementFromModeling.append(tmp)

WMPerElementFromModeling_flat = list(itertools.chain(*WMPerElementFromModeling))
specPerElementFromModeling_flat = list(itertools.chain(*specPerElementFromModeling))

dic_WMandDescription_Model = {}
for i in range(len(WMPerElementFromModeling_flat)):
    dic_WMandDescription_Model[WMPerElementFromModeling_flat[i]] = specPerElementFromModeling_flat[i]

def findAllKeys(dict):
    result = []
    for key in dict.keys():
        result.append(key)
    return result

def findAllValues(dict):
    result = []
    for key in dict.keys():
        result.append(dict[key])
    return result

keys_WMandDescription_Model = findAllKeys(dic_WMandDescription_Model)
keys_WMandDescription_Excel = findAllKeys(dic_WMandDescription_Excel)

keys_WMandDescription_Both = list(set(keys_WMandDescription_Model + keys_WMandDescription_Excel))
values_WMandDescription_Both = []
for i in keys_WMandDescription_Both:
    if i in keys_WMandDescription_Model:
        values_WMandDescription_Both.append(dic_WMandDescription_Model[i])
    else:
        values_WMandDescription_Both.append(dic_WMandDescription_Excel[i])

dic_WMandDescription_Both = {}
for i in range(len(keys_WMandDescription_Both)):
    dic_WMandDescription_Both[keys_WMandDescription_Both[i]] = values_WMandDescription_Both[i]

workMasterCodePerElementFromBoth = []
for i in range(len(workMasterCodePerElement)):
    #tmp = []
    a = WMPerElementFromModeling[i] + workMasterCodePerElement[i]
    b = findUnique(a)
    workMasterCodePerElementFromBoth.append(b)

specPerElement = []
for i in workMasterCodePerElementFromBoth:
    tmp = []
    for j in i:
        tmp.append(dic_WMandDescription_Both[j])
    specPerElement.append(tmp)

fullWMCodeDescriptionPerElement = []
for i in range(len(workMasterCodePerElementFromBoth)):
    tmp = []
    for j in range(len(workMasterCodePerElementFromBoth[i])):
        a = workMasterCodePerElementFromBoth[i][j] +": "+ specPerElement[i][j]
        tmp.append(a)
    fullWMCodeDescriptionPerElement.append(tmp)

fullWMinfo = {
"AllElement": inputElements,
"WorkMasterCodePerFamilyType": dic_FamilyCodeandWM,
"WorkMasterCodePerElementBoth": workMasterCodePerElementFromBoth,
"FullWMCodeDescriptionPerElement": fullWMCodeDescriptionPerElement
}



result = fullWMinfo

# Assign your output to the OUT variable.
OUT = result
# ----------------------------------------

# group: Organize AllElementInform AsDictionary
set_up_all_element_inform_as = Python(IN[0]=excelDataManagerNode)  # "Set Up All Element Inform as Dictionary"; CPython3
# ---------- set_up_all_element_inform_as.python (119 lines) ----------
# Load the Python Standard and DesignScript Libraries
import os
import sys
sys.path.append(os.getenv('LOCALAPPDATA').replace('\\','\\\\') + r'\Programs\Python\Python39\Lib\site-packages')
import clr
clr.AddReference('RevitAPI')
import Autodesk

clr.AddReference('ProtoGeometry')
from Autodesk.DesignScript.Geometry import *

clr.AddReference('RevitNodes')
import Revit
clr.ImportExtensions(Revit.Elements)

clr.ImportExtensions(Revit.GeometryConversion)
clr.ImportExtensions(Revit.GeometryReferences)

clr.AddReference('RevitServices')
import RevitServices
from RevitServices.Persistence import DocumentManager
from RevitServices.Transactions import TransactionManager

doc = DocumentManager.Instance.CurrentDBDocument

import random
import itertools
from functools import reduce
from collections import Iterable
import datetime
import openpyxl

def iterable(obj):
    return isinstance(obj, Iterable)

def findUnique(inputs):
    result = []
    for i in inputs:
        if i in result:
            pass
        else:
            result.append(i)
    return result

# The inputs to this node will be stored as a list in the IN variables.
dataEnteringNode = IN
inputDict = IN[0]


def importExcel(path, SheetNameIn):
    wb_obj = openpyxl.load_workbook(str(path), data_only=True)
    sheet_obj = wb_obj.get_sheet_by_name(str(SheetNameIn))

    m_row = sheet_obj.max_row
    m_col = sheet_obj.max_column

    listOut = []

    for i in range(1, m_row +1):
        listTemp = []
        for j in range(1, m_col + 1):
            cell_obj = sheet_obj.cell(row=i, column=j)
            listTemp.append(cell_obj.value)
            if len(listTemp) == m_col:
                listOut.append(listTemp)
    return listOut

def getUsedFamilyTypeOfModeling(elements):
    familyCode = list(map(lambda x: x.Name.split('_')[0], elements))
    unq_familyCode = findUnique(familyCode)
    return unq_familyCode
    
def createExcelDataDictionary(values):
    result = {}
    for i in range(len(values)):
        result[str(i)] = values[i]
    return result

def findTargetIndex(targets, list):
    result = []
    for target in targets:
        for i in range(len(list)):
            if target in str(list[i]):
                result.append(i)
            else:
                pass
    result.sort()
    return result
    
def GetValueAtKeys(keys, dictionary):
    result = [] 
    for i in keys:
        result.append(dictionary[str(i)])
    return result


# Place your code below this line
element = inputDict["AllElement"]
elementType = []
for i in element:
    elementType.append(i.Name)
familyCode = []
for i in elementType:
    familyCode.append(i.split("_")[0])
fullWMCodeDescriptionPerElement = inputDict["FullWMCodeDescriptionPerElement"]

resultDict = {
"Element": element,
"ElementType": elementType,
"FamilyCode": familyCode,
"FullWMCodeDescriptionPerElement": fullWMCodeDescriptionPerElement
}



result = resultDict

# Assign your output to the OUT variable.
OUT = result
# ----------------------------------------

# group: Select Target Family Element And Connected WorkMasters
code_block_2 = CodeBlock { 0; }
select_target_family_element_and = Python(IN[0]=set_up_all_element_inform_as, IN[1]=code_block_2)  # "Select Target Family Element And Connected WorkMasters"; CPython3
# ---------- select_target_family_element_and.python (138 lines) ----------
# Load the Python Standard and DesignScript Libraries
import os
import sys
sys.path.append(os.getenv('LOCALAPPDATA').replace('\\','\\\\') + r'\Programs\Python\Python39\Lib\site-packages')
import clr
clr.AddReference('RevitAPI')
import Autodesk

clr.AddReference('ProtoGeometry')
from Autodesk.DesignScript.Geometry import *

clr.AddReference('RevitNodes')
import Revit
clr.ImportExtensions(Revit.Elements)

clr.ImportExtensions(Revit.GeometryConversion)
clr.ImportExtensions(Revit.GeometryReferences)

clr.AddReference('RevitServices')
import RevitServices
from RevitServices.Persistence import DocumentManager
from RevitServices.Transactions import TransactionManager

doc = DocumentManager.Instance.CurrentDBDocument

import random
import itertools
from functools import reduce
from collections import Iterable
import datetime
import openpyxl

def iterable(obj):
    return isinstance(obj, Iterable)

def findUnique(inputs):
    result = []
    for i in inputs:
        if i in result:
            pass
        else:
            result.append(i)
    return result

# The inputs to this node will be stored as a list in the IN variables.
dataEnteringNode = IN
inputDict = IN[0]
inputIndex = IN[1]


def importExcel(path, SheetNameIn):
    wb_obj = openpyxl.load_workbook(str(path), data_only=True)
    sheet_obj = wb_obj.get_sheet_by_name(str(SheetNameIn))

    m_row = sheet_obj.max_row
    m_col = sheet_obj.max_column

    listOut = []

    for i in range(1, m_row +1):
        listTemp = []
        for j in range(1, m_col + 1):
            cell_obj = sheet_obj.cell(row=i, column=j)
            listTemp.append(cell_obj.value)
            if len(listTemp) == m_col:
                listOut.append(listTemp)
    return listOut

def getUsedFamilyTypeOfModeling(elements):
    familyCode = list(map(lambda x: x.Name.split('_')[0], elements))
    unq_familyCode = findUnique(familyCode)
    return unq_familyCode
    
def createExcelDataDictionary(values):
    result = {}
    for i in range(len(values)):
        result[str(i)] = values[i]
    return result

def findTargetIndex(targets, list):
    result = []
    for target in targets:
        for i in range(len(list)):
            if target in str(list[i]):
                result.append(i)
            else:
                pass
    result.sort()
    return result
    
def GetValueAtKeys(keys, dictionary):
    result = [] 
    for i in keys:
        result.append(dictionary[str(i)])
    return result


# Place your code below this line
fullWMCodeDescriptionPerElement = inputDict["FullWMCodeDescriptionPerElement"]
element = inputDict["Element"]
familyCode = inputDict["FamilyCode"]
familyCode_unique = findUnique(familyCode)
targetFamilyCode = familyCode_unique[inputIndex]
targetIndex = []
for i in range(len(familyCode)):
    if targetFamilyCode in familyCode[i]:
        targetIndex.append(i)
    else:
        pass

targetElements = []
for i in targetIndex:
    targetElements.append(element[i])

targetFamilyCode = []
for i in targetIndex:
    targetFamilyCode.append(element[i].Name)

WMforTargetElements = []
for i in targetIndex:
    WMforTargetElements.append(fullWMCodeDescriptionPerElement[i])

WMforTargetElements_flat = list(itertools.chain(*WMforTargetElements))
targetWMunique = findUnique(WMforTargetElements_flat)

resultDict = {
"TargetElements": targetElements,
"TargetFamilyCode": targetFamilyCode,
"WMforTargetElements": WMforTargetElements,
"TargetWMunique": targetWMunique
}



result = resultDict

# Assign your output to the OUT variable.
OUT = result
# ----------------------------------------

watch = Watch(select_target_family_element_and)

# group: Select Target Family Element And Connected WorkMasters
# note: 설계변경으로 인한 패밀리 타입 추가 시에 패밀리 타입의 인덱스가 변화할 수 있으므로, 패밀리 타입 이름 지정으로 노드 수정이 추후 필요함
code_block_3 = CodeBlock { 1; }
select_target_family_element_and_2 = Python(IN[0]=set_up_all_element_inform_as, IN[1]=code_block_3)  # "Select Target Family Element And Connected WorkMasters"; CPython3; same code as select_target_family_element_and

watch_2 = Watch(select_target_family_element_and_2)

# group: Select Target Family Element And Connected WorkMasters
# note: 설계변경으로 인한 패밀리 타입 추가 시에 패밀리 타입의 인덱스가 변화할 수 있으므로, 패밀리 타입 이름 지정으로 노드 수정이 추후 필요함
code_block_4 = CodeBlock { 2; }
select_target_family_element_and_3 = Python(IN[0]=set_up_all_element_inform_as, IN[1]=code_block_4)  # "Select Target Family Element And Connected WorkMasters"; CPython3; same code as select_target_family_element_and

watch_3 = Watch(select_target_family_element_and_3)

# group: Output Manager
output = CodeBlock { MainOutput; RefOutput_geoColor; }  # unwired: MainOutput, RefOutput_geoColor
reference_output = CodeBlock { ref; }  # unwired: ref

# group: Visual Manager
visual_켜기_끄기 = BoolSelector(false)
visual_manager = Python(IN[0]=output.RefOutput_geoColor, IN[1]=visual_켜기_끄기)  # CPython3
# ---------- visual_manager.python (18 lines) ----------
# Load the Python Standard and DesignScript Libraries
import sys
import clr
clr.AddReference('ProtoGeometry')
from Autodesk.DesignScript.Geometry import *

# The inputs to this node will be stored as a list in the IN variables.
dataEnteringNode = IN
geoColors = IN[0]
blnForVisual = IN[1]

# Place your code below this line
if blnForVisual == True:
    result = geoColors
else:
    result = 0
# Assign your output to the OUT variable.
OUT = result
# ----------------------------------------

# group: Output Manager
output_2 = CodeBlock { MainOutput; RefOutput_geoColor; }  # unwired: MainOutput, RefOutput_geoColor
reference_output_2 = CodeBlock { ref; }  # unwired: ref

# group: Visual Manager
visual_켜기_끄기_2 = BoolSelector(false)
visual_manager_2 = Python(IN[0]=output_2.RefOutput_geoColor, IN[1]=visual_켜기_끄기_2)  # CPython3; same code as visual_manager

# group: Output Manager
output_3 = CodeBlock { MainOutput; RefOutput_geoColor; }  # unwired: MainOutput, RefOutput_geoColor
reference_output_3 = CodeBlock { ref; }  # unwired: ref

# group: Visual Manager
visual_켜기_끄기_3 = BoolSelector(false)
visual_manager_3 = Python(IN[0]=output_3.RefOutput_geoColor, IN[1]=visual_켜기_끄기_3)  # CPython3; same code as visual_manager

# group: Output Manager
output_4 = CodeBlock { MainOutput; RefOutput_geoColor; }  # unwired: MainOutput, RefOutput_geoColor
reference_output_4 = CodeBlock { ref; }  # unwired: ref

# group: Visual Manager
visual_켜기_끄기_4 = BoolSelector(false)
visual_manager_4 = Python(IN[0]=output_4.RefOutput_geoColor, IN[1]=visual_켜기_끄기_4)  # CPython3; same code as visual_manager

# group: Output Manager
output_5 = CodeBlock { MainOutput; RefOutput_geoColor; }  # unwired: MainOutput, RefOutput_geoColor
reference_output_5 = CodeBlock { ref; }  # unwired: ref

# group: Visual Manager
visual_켜기_끄기_5 = BoolSelector(false)
visual_manager_5 = Python(IN[0]=output_5.RefOutput_geoColor, IN[1]=visual_켜기_끄기_5)  # CPython3; same code as visual_manager

watch_4 = Watch(select_target_family_element_and_2)
watch_5 = Watch(select_target_family_element_and_3)

# group: Output Manager
output_6 = CodeBlock { MainOutput; RefOutput_geoColor; }  # unwired: MainOutput, RefOutput_geoColor
reference_output_6 = CodeBlock { ref; }  # unwired: ref

# group: Visual Manager
visual_켜기_끄기_6 = BoolSelector(false)
visual_manager_6 = Python(IN[0]=output_6.RefOutput_geoColor, IN[1]=visual_켜기_끄기_6)  # CPython3; same code as visual_manager

code_block_5 = CodeBlock(i=select_target_family_element_and_3) { i; }

# group: Input Manager
value_for_import_from_others = CodeBlock(MainInput=code_block_5) { MainInput; RefInput1; RefInput2; }  # unwired: RefInput1, RefInput2

# group: <Func 1> Concrete Work Superstructure Work Anchor Bolt (Installation only) (EA)
code_block_6 = CodeBlock { "TargetElements"; }
# note: <Func>
valueAtKey = DesignScript.Builtin.Dictionary.ValueAtKey(dictionary=value_for_import_from_others.MainInput, key=code_block_6)

# group: Output Manager
output_7 = CodeBlock { MainOutput; RefOutput_geoColor; }  # unwired: MainOutput, RefOutput_geoColor
reference_output_7 = CodeBlock { ref; }  # unwired: ref

# group: Visual Manager
visual_켜기_끄기_7 = BoolSelector(false)
visual_manager_7 = Python(IN[0]=output_7.RefOutput_geoColor, IN[1]=visual_켜기_끄기_7)  # CPython3; same code as visual_manager

# group: Input Manager
value_for_import_from_others_2 = CodeBlock(MainInput=code_block_5) { MainInput; RefInput1; RefInput2; }  # unwired: RefInput1, RefInput2

# group: <Func 6> Anchor Bolt (EA)
code_block_7 = CodeBlock { "TargetElements"; }
# note: <Func>
valueAtKey_2 = DesignScript.Builtin.Dictionary.ValueAtKey(dictionary=value_for_import_from_others_2.MainInput, key=code_block_7)

# group: Output Manager
output_8 = CodeBlock { MainOutput; RefOutput_geoColor; }  # unwired: MainOutput, RefOutput_geoColor
reference_output_8 = CodeBlock { ref; }  # unwired: ref

# group: Visual Manager
visual_켜기_끄기_8 = BoolSelector(false)
visual_manager_8 = Python(IN[0]=output_8.RefOutput_geoColor, IN[1]=visual_켜기_끄기_8)  # CPython3; same code as visual_manager

# group: Input Manager
value_for_import_from_others_3 = CodeBlock(MainInput=code_block_5) { MainInput; RefInput1; RefInput2; }  # unwired: RefInput1, RefInput2

# group: <Func 8> Steel Grout
code_block_8 = CodeBlock { "TargetElements"; }
# note: <Func>
valueAtKey_3 = DesignScript.Builtin.Dictionary.ValueAtKey(dictionary=value_for_import_from_others_3.MainInput, key=code_block_8)

code_block_9 = CodeBlock(i=select_target_family_element_and) { i; }

# group: Input Manager
value_for_import_from_others_4 = CodeBlock(MainInput=code_block_9) { MainInput; RefInput1; RefInput2; }  # unwired: RefInput1, RefInput2

# group: <Func 1> Substructure Work Structural Concrete
code_block_10 = CodeBlock { "TargetElements"; }
# note: <Func>
valueAtKey_4 = DesignScript.Builtin.Dictionary.ValueAtKey(dictionary=value_for_import_from_others_4.MainInput, key=code_block_10)

code_block_11 = CodeBlock { "Volume"; }
# note: <Func>
getParameterValueByName = Element.GetParameterValueByName(element=valueAtKey_4, parameterName=code_block_11)
code_block_12 = CodeBlock(i=getParameterValueByName) { Math.Round(List.Flatten(i)/10000000,2); }
code_block_13 = CodeBlock { "M3"; }
count = List.Count(list=code_block_12)
ofRepeatedItem = List.OfRepeatedItem(item=code_block_13, amount=count)
code_block_14 = CodeBlock(FuncValues=code_block_12, FuncValuesUnit=ofRepeatedItem)
# ---------- code_block_14.designscript (4 lines) ----------
{
"FuncValues": _FuncValues,
"FuncValuesUnit": _FuncValuesUnit
};
# ----------------------------------------

# group: Input Manager
value_for_import_from_others_5 = CodeBlock(MainInput=code_block_9) { MainInput; RefInput1; RefInput2; }  # unwired: RefInput1, RefInput2

# group: <Func 2> Substructure Work Form Work
code_block_15 = CodeBlock { "TargetElements"; }
# note: <Func>
valueAtKey_5 = DesignScript.Builtin.Dictionary.ValueAtKey(dictionary=value_for_import_from_others_5.MainInput, key=code_block_15)

extractSideFacesOfElement = Custom[ExtractSideFacesOfElement](Element=valueAtKey_5)  # ExtractSideFacesOfElement
watch_6 = Watch(extractSideFacesOfElement.Surface)
color_palette = ColorPalette({R: 30, G: 144, B: 255, A: 129})
byGeometryColor = Modifiers.GeometryColor.ByGeometryColor(geometry=watch_6, color=color_palette)
area = Surface.Area(surface=watch_6)
sum = Math.Sum(values=area)
code_block_16 = CodeBlock(i=sum) { Math.Round(List.Flatten(i)/1000000, 2); }
code_block_17 = CodeBlock { "M2"; }
count_2 = List.Count(list=code_block_16)
ofRepeatedItem_2 = List.OfRepeatedItem(item=code_block_17, amount=count_2)
code_block_18 = CodeBlock(FuncValues=code_block_16, FuncValuesUnit=ofRepeatedItem_2)  # same code as code_block_14

# group: Input Manager
value_for_import_from_others_6 = CodeBlock(MainInput=code_block_9) { MainInput; RefInput1; RefInput2; }  # unwired: RefInput1, RefInput2

# group: <Func 3> Substructure Work Rebar Work
code_block_19 = CodeBlock { "TargetElements"; }
# note: <Func>
valueAtKey_6 = DesignScript.Builtin.Dictionary.ValueAtKey(dictionary=value_for_import_from_others_6.MainInput, key=code_block_19)

code_block_20 = CodeBlock { "Volume"; }
getParameterValueByName_2 = Element.GetParameterValueByName(element=valueAtKey_6, parameterName=code_block_20)
sog_철근비 = DoubleInput(0)  # graph input
mul = getParameterValueByName_2 * sog_철근비
code_block_21 = CodeBlock(i=mul) { Math.Round(List.Flatten(i)/1, 2); }
code_block_22 = CodeBlock { "TON"; }
count_3 = List.Count(list=code_block_21)
ofRepeatedItem_3 = List.OfRepeatedItem(item=code_block_22, amount=count_3)
code_block_23 = CodeBlock(FuncValues=code_block_21, FuncValuesUnit=ofRepeatedItem_3)  # same code as code_block_14

# group: Input Manager
value_for_import_from_others_7 = CodeBlock(MainInput=code_block_9) { MainInput; RefInput1; RefInput2; }  # unwired: RefInput1, RefInput2

# group: <Func 4> Concrete Protective Coating (U/G)
code_block_24 = CodeBlock { "TargetElements"; }
# note: <Func>
valueAtKey_7 = DesignScript.Builtin.Dictionary.ValueAtKey(dictionary=value_for_import_from_others_7.MainInput, key=code_block_24)

extractSideFacesOfElement_2 = Custom[ExtractSideFacesOfElement](Element=valueAtKey_7)
watch_7 = Watch(extractSideFacesOfElement_2.Surface)
color_palette_2 = ColorPalette({R: 30, G: 144, B: 255, A: 129})
byGeometryColor_2 = Modifiers.GeometryColor.ByGeometryColor(geometry=watch_7, color=color_palette_2)
area_2 = Surface.Area(surface=watch_7)
sum_2 = Math.Sum(values=area_2)
code_block_25 = CodeBlock(i=sum_2) { Math.Round(List.Flatten(i)/1000000, 2); }
code_block_26 = CodeBlock { "M2"; }
count_4 = List.Count(list=code_block_25)
ofRepeatedItem_4 = List.OfRepeatedItem(item=code_block_26, amount=count_4)
code_block_27 = CodeBlock(FuncValues=code_block_25, FuncValuesUnit=ofRepeatedItem_4)  # same code as code_block_14

# group: Input Manager
value_for_import_from_others_8 = CodeBlock(MainInput=code_block_9) { MainInput; RefInput1; RefInput2; }  # unwired: RefInput1, RefInput2

# group: <Func 5> Concrete Protective Coating (U/G)
code_block_28 = CodeBlock { "TargetElements"; }
# note: <Func>
valueAtKey_8 = DesignScript.Builtin.Dictionary.ValueAtKey(dictionary=value_for_import_from_others_8.MainInput, key=code_block_28)

extractSideFacesOfElement_3 = Custom[ExtractSideFacesOfElement](Element=valueAtKey_8)
watch_8 = Watch(extractSideFacesOfElement_3.Surface)
color_palette_3 = ColorPalette({R: 30, G: 144, B: 255, A: 129})
byGeometryColor_3 = Modifiers.GeometryColor.ByGeometryColor(geometry=watch_8, color=color_palette_3)
area_3 = Surface.Area(surface=watch_8)
sum_3 = Math.Sum(values=area_3)
code_block_29 = CodeBlock(i=sum_3) { Math.Round(List.Flatten(i)/1000000, 2); }
code_block_30 = CodeBlock { "M2"; }
count_5 = List.Count(list=code_block_29)
ofRepeatedItem_5 = List.OfRepeatedItem(item=code_block_30, amount=count_5)
code_block_31 = CodeBlock(FuncValues=code_block_29, FuncValuesUnit=ofRepeatedItem_5)  # same code as code_block_14

# group: Output Manager
output_9 = CodeBlock { MainOutput; RefOutput_geoColor; }  # unwired: MainOutput, RefOutput_geoColor
reference_output_9 = CodeBlock { ref; }  # unwired: ref

# group: Visual Manager
visual_켜기_끄기_9 = BoolSelector(false)
visual_manager_9 = Python(IN[0]=output_9.RefOutput_geoColor, IN[1]=visual_켜기_끄기_9)  # CPython3; same code as visual_manager

# group: Output Manager
output_10 = CodeBlock { MainOutput; RefOutput_geoColor; }  # unwired: MainOutput, RefOutput_geoColor
reference_output_10 = CodeBlock { ref; }  # unwired: ref

# group: Visual Manager
visual_켜기_끄기_10 = BoolSelector(false)
visual_manager_10 = Python(IN[0]=output_10.RefOutput_geoColor, IN[1]=visual_켜기_끄기_10)  # CPython3; same code as visual_manager

# group: Output Manager
output_11 = CodeBlock { MainOutput; RefOutput_geoColor; }  # unwired: MainOutput, RefOutput_geoColor
reference_output_11 = CodeBlock { ref; }  # unwired: ref

# group: Visual Manager
visual_켜기_끄기_11 = BoolSelector(false)
visual_manager_11 = Python(IN[0]=output_11.RefOutput_geoColor, IN[1]=visual_켜기_끄기_11)  # CPython3; same code as visual_manager

# group: Output Manager
output_12 = CodeBlock { MainOutput; RefOutput_geoColor; }  # unwired: MainOutput, RefOutput_geoColor
reference_output_12 = CodeBlock { ref; }  # unwired: ref

# group: Visual Manager
visual_켜기_끄기_12 = BoolSelector(false)
visual_manager_12 = Python(IN[0]=output_12.RefOutput_geoColor, IN[1]=visual_켜기_끄기_12)  # CPython3; same code as visual_manager

code_block_32 = CodeBlock { i; }  # unwired: i

# group: Input Manager
value_for_import_from_others_9 = CodeBlock(MainInput=code_block_32) { MainInput; RefInput1; RefInput2; }  # unwired: RefInput1, RefInput2

# group: <Func 3> Substructure Work Rebar Work
code_block_33 = CodeBlock { "TargetElements"; }
# note: <Func>
valueAtKey_9 = DesignScript.Builtin.Dictionary.ValueAtKey(dictionary=value_for_import_from_others_9.MainInput, key=code_block_33)

code_block_34 = CodeBlock { "Volume"; }
getParameterValueByName_3 = Element.GetParameterValueByName(element=valueAtKey_9, parameterName=code_block_34)
sog_철근비_2 = DoubleInput(0)  # graph input
mul_2 = getParameterValueByName_3 * sog_철근비_2
code_block_35 = CodeBlock(i=mul_2) { Math.Round(List.Flatten(i)/1, 2); }
code_block_36 = CodeBlock { "TON"; }
count_6 = List.Count(list=code_block_35)
ofRepeatedItem_6 = List.OfRepeatedItem(item=code_block_36, amount=count_6)
code_block_37 = CodeBlock(FuncValues=code_block_35, FuncValuesUnit=ofRepeatedItem_6)  # same code as code_block_14

# group: Input Manager
value_for_import_from_others_10 = CodeBlock(MainInput=code_block_32) { MainInput; RefInput1; RefInput2; }  # unwired: RefInput1, RefInput2

# group: <Func 4> Concrete Protective Coating (U/G)
code_block_38 = CodeBlock { "TargetElements"; }
# note: <Func>
valueAtKey_10 = DesignScript.Builtin.Dictionary.ValueAtKey(dictionary=value_for_import_from_others_10.MainInput, key=code_block_38)

extractSideFacesOfElement_4 = Custom[ExtractSideFacesOfElement](Element=valueAtKey_10)
watch_9 = Watch(extractSideFacesOfElement_4.Surface)
color_palette_4 = ColorPalette({R: 30, G: 144, B: 255, A: 129})
byGeometryColor_4 = Modifiers.GeometryColor.ByGeometryColor(geometry=watch_9, color=color_palette_4)
area_4 = Surface.Area(surface=watch_9)
sum_4 = Math.Sum(values=area_4)
code_block_39 = CodeBlock(i=sum_4) { Math.Round(List.Flatten(i)/1000000, 2); }
code_block_40 = CodeBlock { "M2"; }
count_7 = List.Count(list=code_block_39)
ofRepeatedItem_7 = List.OfRepeatedItem(item=code_block_40, amount=count_7)
code_block_41 = CodeBlock(FuncValues=code_block_39, FuncValuesUnit=ofRepeatedItem_7)  # same code as code_block_14

# group: Input Manager
value_for_import_from_others_11 = CodeBlock(MainInput=code_block_32) { MainInput; RefInput1; RefInput2; }  # unwired: RefInput1, RefInput2

# group: <Func 5> Concrete Protective Coating (U/G)
code_block_42 = CodeBlock { "TargetElements"; }
# note: <Func>
valueAtKey_11 = DesignScript.Builtin.Dictionary.ValueAtKey(dictionary=value_for_import_from_others_11.MainInput, key=code_block_42)

extractSideFacesOfElement_5 = Custom[ExtractSideFacesOfElement](Element=valueAtKey_11)
watch_10 = Watch(extractSideFacesOfElement_5.Surface)
color_palette_5 = ColorPalette({R: 30, G: 144, B: 255, A: 129})
byGeometryColor_5 = Modifiers.GeometryColor.ByGeometryColor(geometry=watch_10, color=color_palette_5)
area_5 = Surface.Area(surface=watch_10)
sum_5 = Math.Sum(values=area_5)
code_block_43 = CodeBlock(i=sum_5) { Math.Round(List.Flatten(i)/1000000, 2); }
code_block_44 = CodeBlock { "M2"; }
count_8 = List.Count(list=code_block_43)
ofRepeatedItem_8 = List.OfRepeatedItem(item=code_block_44, amount=count_8)
code_block_45 = CodeBlock(FuncValues=code_block_43, FuncValuesUnit=ofRepeatedItem_8)  # same code as code_block_14

# group: Output Manager
output_13 = CodeBlock { MainOutput; RefOutput_geoColor; }  # unwired: MainOutput, RefOutput_geoColor
reference_output_13 = CodeBlock { ref; }  # unwired: ref

# group: Visual Manager
visual_켜기_끄기_13 = BoolSelector(false)
visual_manager_13 = Python(IN[0]=output_13.RefOutput_geoColor, IN[1]=visual_켜기_끄기_13)  # CPython3; same code as visual_manager

# group: Input Manager
value_for_import_from_others_12 = CodeBlock(MainInput=code_block_32) { MainInput; RefInput1; RefInput2; }  # unwired: RefInput1, RefInput2

# group: <Func 2> Substructure Work Form Work
code_block_46 = CodeBlock { "TargetElements"; }
# note: <Func>
valueAtKey_12 = DesignScript.Builtin.Dictionary.ValueAtKey(dictionary=value_for_import_from_others_12.MainInput, key=code_block_46)

extractSideFacesOfElement_6 = Custom[ExtractSideFacesOfElement](Element=valueAtKey_12)
watch_11 = Watch(extractSideFacesOfElement_6.Surface)
color_palette_6 = ColorPalette({R: 30, G: 144, B: 255, A: 129})
byGeometryColor_6 = Modifiers.GeometryColor.ByGeometryColor(geometry=watch_11, color=color_palette_6)
area_6 = Surface.Area(surface=watch_11)
sum_6 = Math.Sum(values=area_6)
code_block_47 = CodeBlock(i=sum_6) { Math.Round(List.Flatten(i)/1000000, 2); }
code_block_48 = CodeBlock { "M2"; }
count_9 = List.Count(list=code_block_47)
ofRepeatedItem_9 = List.OfRepeatedItem(item=code_block_48, amount=count_9)
code_block_49 = CodeBlock(FuncValues=code_block_47, FuncValuesUnit=ofRepeatedItem_9)  # same code as code_block_14

# group: Input Manager
value_for_import_from_others_13 = CodeBlock(MainInput=code_block_32) { MainInput; RefInput1; RefInput2; }  # unwired: RefInput1, RefInput2

# group: <Func 1> Substructure Work Structural Concrete
code_block_50 = CodeBlock { "TargetElements"; }
# note: <Func>
valueAtKey_13 = DesignScript.Builtin.Dictionary.ValueAtKey(dictionary=value_for_import_from_others_13.MainInput, key=code_block_50)

code_block_51 = CodeBlock { "Volume"; }
getParameterValueByName_4 = Element.GetParameterValueByName(element=valueAtKey_13, parameterName=code_block_51)
code_block_52 = CodeBlock(i=getParameterValueByName_4) { Math.Round(List.Flatten(i)/10000000,2); }
code_block_53 = CodeBlock { "M3"; }
count_10 = List.Count(list=code_block_52)
ofRepeatedItem_10 = List.OfRepeatedItem(item=code_block_53, amount=count_10)
code_block_54 = CodeBlock(FuncValues=code_block_52, FuncValuesUnit=ofRepeatedItem_10)  # same code as code_block_14

# group: Output Manager
output_14 = CodeBlock { MainOutput; RefOutput_geoColor; }  # unwired: MainOutput, RefOutput_geoColor
reference_output_14 = CodeBlock { ref; }  # unwired: ref

# group: Visual Manager
visual_켜기_끄기_14 = BoolSelector(false)
visual_manager_14 = Python(IN[0]=output_14.RefOutput_geoColor, IN[1]=visual_켜기_끄기_14)  # CPython3; same code as visual_manager

# group: Output Manager
output_15 = CodeBlock { MainOutput; RefOutput_geoColor; }  # unwired: MainOutput, RefOutput_geoColor
reference_output_15 = CodeBlock { ref; }  # unwired: ref

# group: Visual Manager
visual_켜기_끄기_15 = BoolSelector(false)
visual_manager_15 = Python(IN[0]=output_15.RefOutput_geoColor, IN[1]=visual_켜기_끄기_15)  # CPython3; same code as visual_manager

# group: Output Manager
output_16 = CodeBlock { MainOutput; RefOutput_geoColor; }  # unwired: MainOutput, RefOutput_geoColor
reference_output_16 = CodeBlock { ref; }  # unwired: ref

# group: Visual Manager
visual_켜기_끄기_16 = BoolSelector(false)
visual_manager_16 = Python(IN[0]=output_16.RefOutput_geoColor, IN[1]=visual_켜기_끄기_16)  # CPython3; same code as visual_manager

code_block_55 = CodeBlock { i; }  # unwired: i

# group: Input Manager
value_for_import_from_others_14 = CodeBlock(MainInput=code_block_55) { MainInput; RefInput1; RefInput2; }  # unwired: RefInput1, RefInput2

# group: <Func 7> Steel Structure Weight
code_block_56 = CodeBlock { "TargetElements"; }
# note: <Func>
valueAtKey_14 = DesignScript.Builtin.Dictionary.ValueAtKey(dictionary=value_for_import_from_others_14.MainInput, key=code_block_56)

code_block_57 = CodeBlock { "Length"; "Mass per Unit Length"; "Surface Area"; }
getParameterValueByName_5 = Element.GetParameterValueByName(element=valueAtKey_14, parameterName=code_block_57.out0)
code_block_58 = CodeBlock(a=getParameterValueByName_5) { a/1000; }
elementType = Element.ElementType(element=valueAtKey_14)
getParameterValueByName_6 = Element.GetParameterValueByName(element=elementType, parameterName=code_block_57.out1)
mul_3 = code_block_58 * getParameterValueByName_6
code_block_59 = CodeBlock(a=mul_3) { a/1000; }

# group: Input Manager
value_for_import_from_others_15 = CodeBlock(MainInput=code_block_55) { MainInput; RefInput1; RefInput2; }  # unwired: RefInput1, RefInput2

# group: <Func 9> Steel Structure Painting
code_block_60 = CodeBlock { "TargetElements"; }
# note: <Func>
valueAtKey_15 = DesignScript.Builtin.Dictionary.ValueAtKey(dictionary=value_for_import_from_others_15.MainInput, key=code_block_60)

code_block_61 = CodeBlock { "Length"; "Mass per Unit Length"; "Surface Area"; }
getParameterValueByName_7 = Element.GetParameterValueByName(element=valueAtKey_15, parameterName=code_block_61.out0)
code_block_62 = CodeBlock(a=getParameterValueByName_7) { a/1000; }
elementType_2 = Element.ElementType(element=valueAtKey_15)
getParameterValueByName_8 = Element.GetParameterValueByName(element=elementType_2, parameterName=code_block_61.out2)
mul_4 = code_block_62 * getParameterValueByName_8

# group: Input Manager
value_for_import_from_others_16 = CodeBlock(MainInput=code_block_55) { MainInput; RefInput1; RefInput2; }  # unwired: RefInput1, RefInput2

# group: <Func 10> Steel Structure Fire Proofing Work
code_block_63 = CodeBlock { "TargetElements"; }
# note: <Func>
valueAtKey_16 = DesignScript.Builtin.Dictionary.ValueAtKey(dictionary=value_for_import_from_others_16.MainInput, key=code_block_63)

code_block_64 = CodeBlock { "Length"; "Mass per Unit Length"; "Surface Area"; }
getParameterValueByName_9 = Element.GetParameterValueByName(element=valueAtKey_16, parameterName=code_block_64.out0)
code_block_65 = CodeBlock(a=getParameterValueByName_9) { a/1000; }
elementType_3 = Element.ElementType(element=valueAtKey_16)
getParameterValueByName_10 = Element.GetParameterValueByName(element=elementType_3, parameterName=code_block_64.out2)
mul_5 = code_block_65 * getParameterValueByName_10

# group: Output Manager
output_17 = CodeBlock { MainOutput; RefOutput_geoColor; }  # unwired: MainOutput, RefOutput_geoColor
reference_output_17 = CodeBlock { ref; }  # unwired: ref

# group: Visual Manager
visual_켜기_끄기_17 = BoolSelector(false)
visual_manager_17 = Python(IN[0]=output_17.RefOutput_geoColor, IN[1]=visual_켜기_끄기_17)  # CPython3; same code as visual_manager

# group: Output Manager
output_18 = CodeBlock { MainOutput; RefOutput_geoColor; }  # unwired: MainOutput, RefOutput_geoColor
reference_output_18 = CodeBlock { ref; }  # unwired: ref

# group: Visual Manager
visual_켜기_끄기_18 = BoolSelector(false)
visual_manager_18 = Python(IN[0]=output_18.RefOutput_geoColor, IN[1]=visual_켜기_끄기_18)  # CPython3; same code as visual_manager

# group: Input Manager
value_for_import_from_others_17 = CodeBlock(MainInput=code_block_55) { MainInput; RefInput1; RefInput2; }  # unwired: RefInput1, RefInput2

# group: <Func2 > Steel Structure Weight
code_block_66 = CodeBlock { "TargetElements"; }
# note: <Func>
valueAtKey_17 = DesignScript.Builtin.Dictionary.ValueAtKey(dictionary=value_for_import_from_others_17.MainInput, key=code_block_66)

code_block_67 = CodeBlock { "Length"; "Mass per Unit Length"; "Surface Area"; }
getParameterValueByName_11 = Element.GetParameterValueByName(element=valueAtKey_17, parameterName=code_block_67.out0)
code_block_68 = CodeBlock(a=getParameterValueByName_11) { a/1000; }
elementType_4 = Element.ElementType(element=valueAtKey_17)
getParameterValueByName_12 = Element.GetParameterValueByName(element=elementType_4, parameterName=code_block_67.out1)
mul_6 = code_block_68 * getParameterValueByName_12
code_block_69 = CodeBlock(a=mul_6) { a/1000; }

# group: Input Manager
value_for_import_from_others_18 = CodeBlock(MainInput=code_block_55, RefInput1=code_block_69) { MainInput; RefInput1; RefInput2; }  # unwired: RefInput2

# group: Output Manager
reference_output_19 = CodeBlock(ref=value_for_import_from_others_18.RefInput1) { ref; }
output_19 = CodeBlock { MainOutput; RefOutput_geoColor; }  # unwired: MainOutput, RefOutput_geoColor

# group: Input Manager
value_for_import_from_others_19 = CodeBlock(MainInput=code_block_55, RefInput1=reference_output_19) { MainInput; RefInput1; RefInput2; }  # unwired: RefInput2

# group: <Func 5> Steel Structure Strength Bolt&Nuts
code_block_70 = CodeBlock { "TargetElements"; }
# note: <Func>
valueAtKey_18 = DesignScript.Builtin.Dictionary.ValueAtKey(dictionary=value_for_import_from_others_19.MainInput, key=code_block_70)

# group: Input Manager
value_for_import_from_others_20 = CodeBlock(MainInput=code_block_55) { MainInput; RefInput1; RefInput2; }  # unwired: RefInput1, RefInput2

# group: <Func 4> Steel Structure Painting/Coating
code_block_71 = CodeBlock { "TargetElements"; }
# note: <Func>
valueAtKey_19 = DesignScript.Builtin.Dictionary.ValueAtKey(dictionary=value_for_import_from_others_20.MainInput, key=code_block_71)

code_block_72 = CodeBlock { "Length"; "Mass per Unit Length"; "Surface Area"; }
getParameterValueByName_13 = Element.GetParameterValueByName(element=valueAtKey_19, parameterName=code_block_72.out0)
code_block_73 = CodeBlock(a=getParameterValueByName_13) { a/1000; }
elementType_5 = Element.ElementType(element=valueAtKey_19)
getParameterValueByName_14 = Element.GetParameterValueByName(element=elementType_5, parameterName=code_block_72.out2)
mul_7 = code_block_73 * getParameterValueByName_14
code_block_74 = CodeBlock(Weight=value_for_import_from_others_19.RefInput1) { Weight; }
strength_bolt_ratio_확인 = DoubleInput(0)  # graph input
code_block_75 = CodeBlock(a=code_block_74, b=strength_bolt_ratio_확인) { a*b; }

# group: Visual Manager
visual_켜기_끄기_19 = BoolSelector(false)
visual_manager_19 = Python(IN[0]=output_19.RefOutput_geoColor, IN[1]=visual_켜기_끄기_19)  # CPython3; same code as visual_manager

# group: <Func 3> Steel Structure Plates
code_block_76 = CodeBlock { "TargetElements"; }
# note: <Func>
valueAtKey_20 = DesignScript.Builtin.Dictionary.ValueAtKey(dictionary=value_for_import_from_others_18.MainInput, key=code_block_76)

code_block_77 = CodeBlock { i; }  # unwired: i
code_block_78 = CodeBlock(Weight=value_for_import_from_others_18.RefInput1) { Weight; }
str_plate_ratio_확인 = DoubleInput(0)  # graph input
code_block_79 = CodeBlock(a=code_block_78, b=str_plate_ratio_확인) { a*b; }

# group: Output Manager
output_20 = CodeBlock { MainOutput; RefOutput_geoColor; }  # unwired: MainOutput, RefOutput_geoColor
reference_output_20 = CodeBlock { ref; }  # unwired: ref

# group: Visual Manager
visual_켜기_끄기_20 = BoolSelector(false)
visual_manager_20 = Python(IN[0]=output_20.RefOutput_geoColor, IN[1]=visual_켜기_끄기_20)  # CPython3; same code as visual_manager

code_block_80 = CodeBlock { i; }  # unwired: i
categories_2 = Categories("OST_StructConnections")
all_elements_of_category_2 = ElementsOfCategory(Category=categories_2)
elementType_6 = Element.ElementType(element=all_elements_of_category_2)
parameters = Element.Parameters(element=elementType_6)
watch_12 = Watch(parameters)
code_block_81 = CodeBlock { "Modify Parameters"; }
getParameterValueByName_15 = Element.GetParameterValueByName(element=elementType_6, parameterName=code_block_81)
geometry = Element.Geometry(element=all_elements_of_category_2)
select_model_elements = DSModelElementsSelection()  # 1 picked in the model
python_script = Python(IN[0]=select_model_elements)  # IronPython2
# ---------- python_script.python (47 lines) ----------
import clr
clr.AddReference('ProtoGeometry')
from Autodesk.DesignScript.Geometry import *

import clr
import sys
pyt_path = r'C:\Program Files (x86)\IronPython 2.7\Lib'
sys.path.append(pyt_path)
import os
import webbrowser
import unicodedata

clr.AddReference('RevitAPISteel')
clr.AddReference('RevitAPI')
from Autodesk.Revit.DB import *

clr.AddReference('RevitAPIUI')
from Autodesk.Revit.UI import Selection

clr.AddReference('RevitNodes')
import Revit
clr.ImportExtensions(Revit.Elements)
clr.ImportExtensions(Revit.GeometryConversion)

clr.AddReference('RevitServices')
from RevitServices.Persistence import DocumentManager
from RevitServices.Transactions import TransactionManager

clr.AddReference('DSCoreNodes')
from DSCore import *

doc = DocumentManager.Instance.CurrentDBDocument
uidoc = DocumentManager.Instance.CurrentUIApplication.ActiveUIDocument
views = doc.ActiveView

colec = FilteredElementCollector(doc).OfCategory(BuiltInCategory.OST_StructConnectionPlates).WhereElementIsNotElementType().ToElements()
connection = UnwrapElement(IN[0])

TransactionManager.Instance.EnsureInTransaction(doc)
opt = Options()
opt.ComputeReferences = True
opt.IncludeNonVisibleObjects = True
opt.View = doc.ActiveView
geo = connection.get_Geometry(opt)
TransactionManager.Instance.TransactionTaskDone()

OUT = geo
# ----------------------------------------
code_block_82 = CodeBlock { "Autodesk.Revit.DB.Solid"; }
type = Object.Type(object=python_script)
contains = String.Contains(string=code_block_82, searchFor=type)
filterByBoolMask = List.FilterByBoolMask(list=python_script, mask=contains)
geometry_2 = Element.Geometry(element=python_script)
