# Dynamo graph 04 Str Foundation (220110) Slab edge 추가.dyn (Dynamo 2.12.0.5650)

# note: 되메우기기

code_block = CodeBlock { i; }  # unwired: i

# group: Input Manager
value_for_import_from_others = CodeBlock(MainInput=code_block) { MainInput; RefInput1; RefInput2; }  # unwired: RefInput1, RefInput2

# group: <Func 9>Lean Concrete
code_block_2 = CodeBlock { "TargetElements"; }
valueAtKey = DesignScript.Builtin.Dictionary.ValueAtKey(dictionary=value_for_import_from_others.MainInput, key=code_block_2)
code_block_3 = CodeBlock { 0; 100; }
# note: <Func>
createLeanConcrete = Custom[CreateLeanConcrete](Element=valueAtKey, leanOffset=code_block_3.out0, leanThick=code_block_3.out1)  # CreateLeanConcreteForISOFDN
volume = Solid.Volume(solid=createLeanConcrete.Solid)
code_block_4 = CodeBlock(i=volume) { Math.Round(List.Flatten(i)/1000000000, 2); }
code_block_5 = CodeBlock { "M3"; }
count = List.Count(list=code_block_4)
ofRepeatedItem = List.OfRepeatedItem(item=code_block_5, amount=count)
code_block_6 = CodeBlock(FuncValues=code_block_4, FuncValuesUnit=ofRepeatedItem)
# ---------- code_block_6.designscript (4 lines) ----------
{
"FuncValues": _FuncValues,
"FuncValuesUnit": _FuncValuesUnit
};
# ----------------------------------------

# group: Output Manager
reference_output = CodeBlock(ref=createLeanConcrete.Solid) { ref; }
output = CodeBlock(MainOutput=code_block_6, RefOutput_geoColor=createLeanConcrete.Solid) { MainOutput; RefOutput_geoColor; }

# group: Input Manager
value_for_import_from_others_2 = CodeBlock(MainInput=code_block, RefInput1=reference_output) { MainInput; RefInput1; RefInput2; }  # unwired: RefInput2

# group: <Func 4> Excavation (SOG 한정)
flatten = List.Flatten(list=value_for_import_from_others_2.RefInput1)
하부_surface_추출 = Python(IN[0]=flatten)  # CPython3
# ---------- 하부_surface_추출.python (26 lines) ----------
# Load the Python Standard and DesignScript Libraries
import sys
import clr
import itertools
clr.AddReference('ProtoGeometry')
from Autodesk.DesignScript.Geometry import *

# The inputs to this node will be stored as a list in the IN variables.
dataEnteringNode = IN
input_elements = IN[0]

# Place your code below this line

srfs_input_elements = list(map(lambda x: x.Explode(), input_elements))

#srfs_input_flatten = list(itertools.chain(*srfs_input_elements))

def func_findZ_normalAtParma(srf):
    return srf.NormalAtParameter(0.5,0.5).Z
srfs_below = list(map(lambda y: filter(lambda x: func_findZ_normalAtParma(x) == -1, y), srfs_input_elements))

result = srfs_below


# Assign your output to the OUT variable.
OUT = result
# ----------------------------------------
flatten_2 = List.Flatten(list=하부_surface_추출)
perimeterCurves = Surface.PerimeterCurves(surface=flatten_2)
byJoinedCurves = PolyCurve.ByJoinedCurves(curves=perimeterCurves)
code_block_7 = CodeBlock { _ExcavOffsetBottom: var[]..[] = 300; }
offset = Curve.Offset(curve=byJoinedCurves, distance=code_block_7)
flatten_3 = List.Flatten(list=offset)
levels = Levels("G.L")  # graph input
elevation = Level.Elevation(level=levels)
code_block_8 = CodeBlock { "TargetElements"; }
valueAtKey_2 = DesignScript.Builtin.Dictionary.ValueAtKey(dictionary=value_for_import_from_others_2.MainInput, key=code_block_8)
code_block_9 = CodeBlock { "Elevation at Bottom"; }
getParameterValueByName = Element.GetParameterValueByName(element=valueAtKey_2, parameterName=code_block_9)
린_콘크리트_하부까지의_길이_추출_최하단 = Python(IN[0]=value_for_import_from_others_2.RefInput1)  # CPython3
# ---------- 린_콘크리트_하부까지의_길이_추출_최하단.python (22 lines) ----------
# Load the Python Standard and DesignScript Libraries
import sys
import clr
clr.AddReference('ProtoGeometry')
from Autodesk.DesignScript.Geometry import *

# The inputs to this node will be stored as a list in the IN variables.
dataEnteringNode = IN
inputs = IN[0]

# Place your code below this line

def findThickness(i):
    minPt_Z = BoundingBox.ByGeometry(i).MinPoint.Z
    maxPt_Z = BoundingBox.ByGeometry(i).MaxPoint.Z
    result = maxPt_Z - minPt_Z
    return result

thicknessByInput = list(map(findThickness, inputs))

# Assign your output to the OUT variable.
OUT = thicknessByInput
# ----------------------------------------
code_block_10 = CodeBlock(기초하단=getParameterValueByName, 린콘크리트하단=린_콘크리트_하부까지의_길이_추출_최하단) { 기초하단-린콘크리트하단; }
sub = elevation - code_block_10
flatten_4 = List.Flatten(list=sub)
translate = Geometry.Translate(geometry=offset, zTranslation=flatten_4)
경사_비율_입력_1_x_for_isofdn = DoubleInput(2)  # graph input
code_block_11 = CodeBlock(ElevationatBottom=flatten_4, 비율=경사_비율_입력_1_x_for_isofdn) { ElevationatBottom/비율; }
offset_2 = Curve.Offset(curve=translate, distance=code_block_11)
flatten_5 = List.Flatten(list=offset_2)
list_create = List.Create(item0=flatten_3, item1=flatten_5)
transpose = List.Transpose(lists=list_create)
byLoft = Solid.ByLoft(crossSections=transpose)
터파기_형상_겹침_해소 = Python(IN[0]=byLoft)  # CPython3
# ---------- 터파기_형상_겹침_해소.python (29 lines) ----------
# Load the Python Standard and DesignScript Libraries
import sys
import clr
clr.AddReference('ProtoGeometry')
from Autodesk.DesignScript.Geometry import *

# The inputs to this node will be stored as a list in the IN variables.
dataEnteringNode = IN
inputs = IN[0]
result = []
# Place your code below this line

for x in range(len(inputs)):
    if x < len(inputs)-1:
        temp = []
        apply = inputs[x]
        for y in range(x,len(inputs)):
            if apply.DoesIntersect(inputs[y]):
                apply = apply.Split(inputs[y])[0]
                temp.append(apply)
            else:
                apply = apply
                temp.append(apply)
        result.append(temp[-1])
    elif x == len(inputs)-1:
        result.append(inputs[x])

# Assign your output to the OUT variable.
OUT = result
# ----------------------------------------
code_block_12 = CodeBlock(i=sub) { i<0?true:false; }
code_block_13 = CodeBlock { 0; }
volume_2 = Solid.Volume(solid=터파기_형상_겹침_해소)
code_block_14 = CodeBlock(i=volume_2) { Math.Round(List.Flatten(i)/1000000000, 2); }
if_ = If(test=code_block_12, true=code_block_13, false=code_block_14)
code_block_15 = CodeBlock { "M3"; }
count_2 = List.Count(list=code_block_14)
ofRepeatedItem_2 = List.OfRepeatedItem(item=code_block_15, amount=count_2)
code_block_16 = CodeBlock(FuncValues=if_, FuncValuesUnit=ofRepeatedItem_2)  # same code as code_block_6
color_palette = ColorPalette({R: 210, G: 105, B: 30, A: 135})
byGeometryColor = Modifiers.GeometryColor.ByGeometryColor(geometry=터파기_형상_겹침_해소, color=color_palette)
forRefOutput = CodeBlock(MainOutput=code_block_16, geoColor=byGeometryColor, 터파기형상=터파기_형상_겹침_해소)
# ---------- forRefOutput.designscript (5 lines) ----------
{
"MainOutput": MainOutput,
"geoColor": geoColor,
"터파기형상": 터파기형상
};
# ----------------------------------------

# group: Output Manager
reference_output_2 = CodeBlock(ref=터파기_형상_겹침_해소, ref2=if_) { ref; ref2; }
output_2 = CodeBlock(MainOutput=forRefOutput, RefOutput_geoColor=byGeometryColor) { MainOutput; RefOutput_geoColor; }

# group: Input Manager
value_for_import_from_others_3 = CodeBlock(MainInput=code_block, RefInput1=reference_output_2.ref2) { MainInput; RefInput1; RefInput2; }  # unwired: RefInput2

# group: <Func 6>Disposal
code_block_17 = CodeBlock { "TargetElements"; }
valueAtKey_3 = DesignScript.Builtin.Dictionary.ValueAtKey(dictionary=value_for_import_from_others_3.MainInput, key=code_block_17)
count_3 = List.Count(list=valueAtKey_3@L1)
code_block_18 = CodeBlock(i=value_for_import_from_others_3.RefInput1) { i==0?true:false; }
code_block_19 = CodeBlock { 0; }
# note: <Func>
if_2 = If(test=code_block_18, true=code_block_19, false=value_for_import_from_others_3.RefInput1)
code_block_20 = CodeBlock(i=if_2) { Math.Round(List.Flatten(i)/1000000000, 2); }
code_block_21 = CodeBlock { "M3"; }
count_4 = List.Count(list=code_block_20)
ofRepeatedItem_3 = List.OfRepeatedItem(item=code_block_21, amount=count_4)
code_block_22 = CodeBlock(FuncValues=code_block_20, FuncValuesUnit=ofRepeatedItem_3)  # same code as code_block_6

code_block_23 = CodeBlock { i; }  # unwired: i

# group: <Func 0> Input Manager
value_for_import_from_others_4 = CodeBlock(MainInput=code_block_23) { MainInput; RefInput; }  # unwired: RefInput

# group: <Func 0> Structural Concrete
code_block_24 = CodeBlock { "TargetElements"; }
valueAtKey_4 = DesignScript.Builtin.Dictionary.ValueAtKey(dictionary=value_for_import_from_others_4.MainInput, key=code_block_24)
code_block_25 = CodeBlock { "Volume"; }
# note: <Func>
getParameterValueByName_2 = Element.GetParameterValueByName(element=valueAtKey_4, parameterName=code_block_25)
code_block_26 = CodeBlock(i=getParameterValueByName_2) { Math.Round(List.Flatten(i)/1, 2); }
code_block_27 = CodeBlock { "M3"; }
count_5 = List.Count(list=code_block_26)
ofRepeatedItem_4 = List.OfRepeatedItem(item=code_block_27, amount=count_5)
code_block_28 = CodeBlock(FuncValues=code_block_26, FuncValuesUnit=ofRepeatedItem_4)  # same code as code_block_6

# group: <Func 0> Output Manager
output_3 = CodeBlock(MainOutput=code_block_28) { MainOutput; RefOutput1; RefOutput2; }  # unwired: RefOutput1, RefOutput2
reference_output_3 = CodeBlock { ref; }  # unwired: ref

# group: <Func 5> Input Manager
value_for_import_from_others_5 = CodeBlock(MainInput=code_block_23) { MainInput; RefInput; }  # unwired: RefInput

# group: <Func 5> Lean Concrete
code_block_29 = CodeBlock { "TargetElements"; }
valueAtKey_5 = DesignScript.Builtin.Dictionary.ValueAtKey(dictionary=value_for_import_from_others_5.MainInput, key=code_block_29)
# note: <Func>
createLeanConcrete_2 = Custom[CreateLeanConcrete](Element=valueAtKey_5)
flatten_6 = List.Flatten(list=createLeanConcrete_2.Solid)
value_for_export_to_others = CodeBlock(린콘크리트형상=flatten_6) { 린콘크리트형상; }
volume_3 = Solid.Volume(solid=createLeanConcrete_2.Solid)
code_block_30 = CodeBlock(i=volume_3) { Math.Round(List.Flatten(i)/1000000000, 2); }
code_block_31 = CodeBlock { "M3"; }
count_6 = List.Count(list=code_block_30)
ofRepeatedItem_5 = List.OfRepeatedItem(item=code_block_31, amount=count_6)
code_block_32 = CodeBlock(FuncValues=code_block_30, FuncValuesUnit=ofRepeatedItem_5)  # same code as code_block_6

# group: <Func 5> Output Manager
reference_output_4 = CodeBlock(ref=value_for_export_to_others) { ref; }
output_4 = CodeBlock(MainOutput=code_block_32, RefOutput_geoColor=createLeanConcrete_2.GeometryColor) { MainOutput; RefOutput_geoColor; }

# group: <Func 1> Input Manager
value_for_import_from_others_6 = CodeBlock(MainInput=code_block_23, RefInput=reference_output_4) { MainInput; RefInput; }

# group: <Func 1-1> Excavation by IsoFDN
하부_surface_추출_2 = Python(IN[0]=value_for_import_from_others_6.RefInput)  # CPython3; same code as 하부_surface_추출
flatten_7 = List.Flatten(list=하부_surface_추출_2)
perimeterCurves_2 = Surface.PerimeterCurves(surface=flatten_7)
byJoinedCurves_2 = PolyCurve.ByJoinedCurves(curves=perimeterCurves_2)
code_block_33 = CodeBlock { _ExcavOffsetBottom: var[]..[] = 300; }
offset_3 = Curve.Offset(curve=byJoinedCurves_2, distance=code_block_33)
flatten_8 = List.Flatten(list=offset_3)
levels_2 = Levels("G.L")  # graph input
elevation_2 = Level.Elevation(level=levels_2)
code_block_34 = CodeBlock { "TargetElements"; }
valueAtKey_6 = DesignScript.Builtin.Dictionary.ValueAtKey(dictionary=value_for_import_from_others_6.MainInput, key=code_block_34)
code_block_35 = CodeBlock { "Elevation at Bottom"; }
getParameterValueByName_3 = Element.GetParameterValueByName(element=valueAtKey_6, parameterName=code_block_35)
린_콘크리트_하부까지의_길이_추출_최하단_2 = Python(IN[0]=value_for_import_from_others_6.RefInput)  # CPython3; same code as 린_콘크리트_하부까지의_길이_추출_최하단
code_block_36 = CodeBlock(기초하단=getParameterValueByName_3, 린콘크리트하단=린_콘크리트_하부까지의_길이_추출_최하단_2) { 기초하단-린콘크리트하단; }
sub_2 = elevation_2 - code_block_36
code_block_37 = CodeBlock { 0; }
isNull = Object.IsNull()  # unwired: object
replaceByCondition = Replace(item=sub_2, replaceWith=code_block_37, condition=isNull)
flatten_9 = List.Flatten(list=replaceByCondition)
translate_2 = Geometry.Translate(geometry=offset_3, zTranslation=flatten_9)
경사_비율_입력_1_x_for_isofdn_2 = DoubleInput(2)  # graph input
code_block_38 = CodeBlock(ElevationatBottom=flatten_9, 비율=경사_비율_입력_1_x_for_isofdn_2) { ElevationatBottom/비율; }
offset_4 = Curve.Offset(curve=translate_2, distance=code_block_38)
flatten_10 = List.Flatten(list=offset_4)
list_create_2 = List.Create(item0=flatten_8, item1=flatten_10)
transpose_2 = List.Transpose(lists=list_create_2)
byLoft_2 = Solid.ByLoft(crossSections=transpose_2)
터파기_형상_겹침_해소_2 = Python(IN[0]=byLoft_2)  # CPython3; same code as 터파기_형상_겹침_해소
volume_4 = Solid.Volume(solid=터파기_형상_겹침_해소_2)
code_block_39 = CodeBlock(i=volume_4) { Math.Round(List.Flatten(i)/1000000000, 2); }
code_block_40 = CodeBlock { "M3"; }
count_7 = List.Count(list=code_block_39)
ofRepeatedItem_6 = List.OfRepeatedItem(item=code_block_40, amount=count_7)
code_block_41 = CodeBlock(FuncValues=code_block_39, FuncValuesUnit=ofRepeatedItem_6)  # same code as code_block_6
color_palette_2 = ColorPalette({R: 210, G: 105, B: 30, A: 135})
byGeometryColor_2 = Modifiers.GeometryColor.ByGeometryColor(geometry=터파기_형상_겹침_해소_2, color=color_palette_2)
forRefOutput_2 = CodeBlock(MainOutput=code_block_41, geoColor=byGeometryColor_2, 터파기형상=터파기_형상_겹침_해소_2)  # same code as forRefOutput

# group: <Func 1-2> Excavation by Overall
하부_surface_추출_3 = Python(IN[0]=value_for_import_from_others_6.RefInput)  # CPython3; same code as 하부_surface_추출
flatten_11 = List.Flatten(list=하부_surface_추출_3)
byGeometry = BoundingBox.ByGeometry(geom=flatten_11)
toCuboid = BoundingBox.ToCuboid(boundingBox=byGeometry)
code_block_42 = CodeBlock(i=toCuboid) { [i]; }
하부_surface_추출_4 = Python(IN[0]=code_block_42)  # CPython3; same code as 하부_surface_추출
perimeterCurves_3 = Surface.PerimeterCurves(surface=하부_surface_추출_4)
byJoinedCurves_3 = PolyCurve.ByJoinedCurves(curves=perimeterCurves_3)
code_block_43 = CodeBlock { _ExcavOffsetBottom: var[]..[] = 300; }
offset_5 = Curve.Offset(curve=byJoinedCurves_3, distance=code_block_43)
flatten_12 = List.Flatten(list=offset_5)
levels_3 = Levels("G.L")  # graph input
elevation_3 = Level.Elevation(level=levels_3)
code_block_44 = CodeBlock { "TargetElements"; }
valueAtKey_7 = DesignScript.Builtin.Dictionary.ValueAtKey(dictionary=value_for_import_from_others_6.MainInput, key=code_block_44)
code_block_45 = CodeBlock { "Elevation at Bottom"; }
getParameterValueByName_4 = Element.GetParameterValueByName(element=valueAtKey_7, parameterName=code_block_45)
린_콘크리트_하부까지의_길이_추출_최하단_3 = Python(IN[0]=value_for_import_from_others_6.RefInput)  # CPython3; same code as 린_콘크리트_하부까지의_길이_추출_최하단
code_block_46 = CodeBlock(기초하단=getParameterValueByName_4, 린콘크리트하단=린_콘크리트_하부까지의_길이_추출_최하단_3) { 기초하단-린콘크리트하단; }
uniqueItems = List.UniqueItems(list=code_block_46@L2)
sub_3 = elevation_3 - uniqueItems
code_block_47 = CodeBlock { 0; }
isNull_2 = Object.IsNull()  # unwired: object
replaceByCondition_2 = Replace(item=sub_3, replaceWith=code_block_47, condition=isNull_2)
flatten_13 = List.Flatten(list=replaceByCondition_2)
translate_3 = Geometry.Translate(geometry=offset_5, zTranslation=flatten_13)
경사_비율_입력_1_x_for_overall = DoubleInput(2)  # graph input
code_block_48 = CodeBlock(ElevationatBottom=flatten_13, 비율=경사_비율_입력_1_x_for_overall) { ElevationatBottom/비율; }
offset_6 = Curve.Offset(curve=translate_3, distance=code_block_48)
flatten_14 = List.Flatten(list=offset_6)
list_create_3 = List.Create(item0=flatten_12, item1=flatten_14)
transpose_3 = List.Transpose(lists=list_create_3)
byLoft_3 = Solid.ByLoft(crossSections=transpose_3)
터파기_형상_겹침_해소_3 = Python(IN[0]=byLoft_3)  # CPython3; same code as 터파기_형상_겹침_해소
volume_5 = Solid.Volume(solid=터파기_형상_겹침_해소_3)
code_block_49 = CodeBlock(i=volume_5) { Math.Round(List.Flatten(i)/1000000000, 2); }
code_block_50 = CodeBlock { "M3"; }
count_8 = List.Count(list=code_block_49)
ofRepeatedItem_7 = List.OfRepeatedItem(item=code_block_50, amount=count_8)
code_block_51 = CodeBlock(FuncValues=code_block_49, FuncValuesUnit=ofRepeatedItem_7)  # same code as code_block_6
color_palette_3 = ColorPalette({R: 210, G: 105, B: 30, A: 135})
byGeometryColor_3 = Modifiers.GeometryColor.ByGeometryColor(geometry=터파기_형상_겹침_해소_3, color=color_palette_3)
forRefOutput_3 = CodeBlock(MainOutput=code_block_51, geoColor=byGeometryColor_3, 터파기형상=터파기_형상_겹침_해소_3)  # same code as forRefOutput

# group: 함수 선택
터파기_산출_타입_선택_iso_or_overall = StringInput("iso")  # graph input
code_block_52 = CodeBlock(functionName=터파기_산출_타입_선택_iso_or_overall) { functionName == "iso"? true:false; }
if_3 = If(test=code_block_52, true=forRefOutput_2, false=forRefOutput_3)

# group: <Func 1> Output Manager
code_block_53 = CodeBlock { "MainOutput"; }
valueAtKey_8 = DesignScript.Builtin.Dictionary.ValueAtKey(dictionary=if_3, key=code_block_53)
code_block_54 = CodeBlock { "geoColor"; }
valueAtKey_9 = DesignScript.Builtin.Dictionary.ValueAtKey(dictionary=if_3, key=code_block_54)
output_5 = CodeBlock(MainOutput=valueAtKey_8, RefOutput_geoColor=valueAtKey_9) { MainOutput; RefOutput_geoColor; }
code_block_55 = CodeBlock { "터파기형상"; }
valueAtKey_10 = DesignScript.Builtin.Dictionary.ValueAtKey(dictionary=if_3, key=code_block_55)
reference_output_5 = CodeBlock(터파기형상=valueAtKey_10) { 터파기형상; }

# group: <Func 2> Input Manager
value_for_import_from_others_7 = CodeBlock(MainInput=code_block_23, RefInput1=reference_output_5, RefInput2=reference_output_4) { MainInput; RefInput1; RefInput2; }

# group: <Func 2> Backfill
value_for_import_from_others_8 = CodeBlock(터파기형상=value_for_import_from_others_7.RefInput1) { 터파기형상; }
flatten_15 = List.Flatten(list=value_for_import_from_others_8)
volume_6 = Solid.Volume(solid=flatten_15)
flatten_16 = List.Flatten(list=value_for_import_from_others_7.RefInput2)
code_block_56 = CodeBlock { "TargetElements"; }
valueAtKey_11 = DesignScript.Builtin.Dictionary.ValueAtKey(dictionary=value_for_import_from_others_7.MainInput, key=code_block_56)
geometry = Element.Geometry(element=valueAtKey_11)
flatten_17 = List.Flatten(list=geometry)
categories = Categories("OST_StructuralColumns")
all_elements_of_category = ElementsOfCategory(Category=categories)
geometry_2 = Element.Geometry(element=all_elements_of_category)
flatten_18 = List.Flatten(list=geometry_2)
doesIntersect = Geometry.DoesIntersect(geometry=flatten_15, other=flatten_18, lacing=CrossProduct)
filterByBoolMask = List.FilterByBoolMask(list=flatten_18, mask=doesIntersect@L2)
flatten_19 = List.Flatten(list=filterByBoolMask.in)
list_create_4 = List.Create(item0=flatten_16, item1=flatten_17, item2=flatten_19)
transpose_4 = List.Transpose(lists=list_create_4)
byUnion = Solid.ByUnion(solids=transpose_4)
volume_7 = Solid.Volume(solid=byUnion)
code_block_57 = CodeBlock(터파기볼륨=volume_6, 콘크리트들볼륨=volume_7) { 터파기볼륨 - 콘크리트들볼륨; }
watch = Watch(code_block_57)
code_block_58 = CodeBlock(i=watch) { Math.Round(List.Flatten(i)/1000000000, 2); }
code_block_59 = CodeBlock { "M3"; }
count_9 = List.Count(list=watch)
ofRepeatedItem_8 = List.OfRepeatedItem(item=code_block_59, amount=count_9)
# note: 터파기 물량ㅈ에서 콘크리트, 린 기둥 물량 빼기
code_block_60 = CodeBlock(FuncValues=code_block_58, FuncValuesUnit=ofRepeatedItem_8)  # same code as code_block_6

# group: <Func 2> Output Manager
output_6 = CodeBlock(MainOutput=code_block_60) { MainOutput; RefOutput_geoColor; }  # unwired: RefOutput_geoColor
reference_output_6 = CodeBlock(콘크리트들볼륨=volume_7) { 콘크리트들볼륨; }

# group: <Func 3> Input Manager
value_for_import_from_others_9 = CodeBlock(MainInput=code_block_23, RefInput1=reference_output_6) { MainInput; RefInput1; RefInput2; }  # unwired: RefInput2

# group: <Func 3> Disposal (잔토처리 1.2 비율)
watch_2 = Watch(value_for_import_from_others_9.RefInput1)
토량_환산_계수 = DoubleInput(1)  # graph input
code_block_61 = CodeBlock(i=watch_2, 토량환산계수=토량_환산_계수) { Math.Round(List.Flatten(i)/1000000000, 2)*토량환산계수; }
code_block_62 = CodeBlock { "M3"; }
count_10 = List.Count(list=watch_2)
ofRepeatedItem_9 = List.OfRepeatedItem(item=code_block_62, amount=count_10)
# note: 잔토처리
code_block_63 = CodeBlock(FuncValues=code_block_61, FuncValuesUnit=ofRepeatedItem_9)  # same code as code_block_6

# group: <Func 3> Output Manager
output_7 = CodeBlock(MainOutput=code_block_63) { MainOutput; RefOutput_geoColor; }  # unwired: RefOutput_geoColor
reference_output_7 = CodeBlock { ref; }  # unwired: ref

# group: <Func 4> Input Manager
value_for_import_from_others_10 = CodeBlock(MainInput=code_block_23) { MainInput; RefInput1; RefInput2; }  # unwired: RefInput1, RefInput2

code_block_64 = CodeBlock { 300; 100; }

# group: <Func 4> Base Course
code_block_65 = CodeBlock { "TargetElements"; }
valueAtKey_12 = DesignScript.Builtin.Dictionary.ValueAtKey(dictionary=value_for_import_from_others_10.MainInput, key=code_block_65)
# note: <Func>
createBaseCourseSurfaces = Custom[CreateBaseCourseSurfaces](Element=valueAtKey_12, BaseCourseOffsetBottom=code_block_64.out0, leanThick=code_block_64.out1)  # CreateBaseCourseSurfaces
area = Surface.Area(surface=createBaseCourseSurfaces.Surface)
code_block_66 = CodeBlock(i=area) { Math.Round(List.Flatten(i)/1000000, 2); }
code_block_67 = CodeBlock { "M2"; }
count_11 = List.Count(list=code_block_66)
ofRepeatedItem_10 = List.OfRepeatedItem(item=code_block_67, amount=count_11)
code_block_68 = CodeBlock(FuncValues=code_block_66, FuncValuesUnit=ofRepeatedItem_10)  # same code as code_block_6

# group: <Func 4> Output Manager
output_8 = CodeBlock(MainOutput=code_block_68, RefOutput_geoColor=createBaseCourseSurfaces.GeometryColor) { MainOutput; RefOutput_geoColor; }
reference_output_8 = CodeBlock { ref; }  # unwired: ref

# group: <Func 6> Input Manager
value_for_import_from_others_11 = CodeBlock(MainInput=code_block_23) { MainInput; RefInput1; RefInput2; }  # unwired: RefInput1, RefInput2

# group: <Func 6> Form Works
code_block_69 = CodeBlock { "TargetElements"; }
valueAtKey_13 = DesignScript.Builtin.Dictionary.ValueAtKey(dictionary=value_for_import_from_others_11.MainInput, key=code_block_69)
# note: <Func>
extractSideFacesOfElement = Custom[ExtractSideFacesOfElement](Element=valueAtKey_13)  # ExtractSideFacesOfElement
area_2 = Surface.Area(surface=extractSideFacesOfElement.Surface)
sum = Math.Sum(values=area_2)
code_block_70 = CodeBlock(i=sum) { Math.Round(List.Flatten(i)/1000000, 2); }
code_block_71 = CodeBlock { "M2"; }
count_12 = List.Count(list=code_block_70)
ofRepeatedItem_11 = List.OfRepeatedItem(item=code_block_71, amount=count_12)
code_block_72 = CodeBlock(FuncValues=code_block_70, FuncValuesUnit=ofRepeatedItem_11)  # same code as code_block_6

# group: <Func 6> Output Manager
output_9 = CodeBlock(MainOutput=code_block_72, RefOutput_geoColor=extractSideFacesOfElement.GeometryColor) { MainOutput; RefOutput_geoColor; }
reference_output_9 = CodeBlock { ref; }  # unwired: ref

# group: <Func 7> Input Manager
value_for_import_from_others_12 = CodeBlock(MainInput=code_block_23) { MainInput; RefInput1; RefInput2; factor; }  # unwired: RefInput1, RefInput2, factor

# group: <Func 7> Rebar
code_block_73 = CodeBlock { "TargetElements"; }
valueAtKey_14 = DesignScript.Builtin.Dictionary.ValueAtKey(dictionary=value_for_import_from_others_12.MainInput, key=code_block_73)
code_block_74 = CodeBlock { "Volume"; }
# note: <Func>
getParameterValueByName_5 = Element.GetParameterValueByName(element=valueAtKey_14, parameterName=code_block_74)
독립기초_철근비 = DoubleInput(0)  # graph input
mul = getParameterValueByName_5 * 독립기초_철근비
code_block_75 = CodeBlock(i=mul) { Math.Round(List.Flatten(i)/1, 2); }
code_block_76 = CodeBlock { "TON"; }
count_13 = List.Count(list=code_block_75)
ofRepeatedItem_12 = List.OfRepeatedItem(item=code_block_76, amount=count_13)
code_block_77 = CodeBlock(FuncValues=code_block_75, FuncValuesUnit=ofRepeatedItem_12)  # same code as code_block_6

# group: <Func 7> Output Manager
output_10 = CodeBlock(MainOutput=code_block_77) { MainOutput; RefOutput_geoColor; }  # unwired: RefOutput_geoColor
reference_output_10 = CodeBlock { ref; }  # unwired: ref

# group: <Func 8> Input Manager
value_for_import_from_others_13 = CodeBlock(MainInput=code_block_23) { MainInput; RefInput1; RefInput2; }  # unwired: RefInput1, RefInput2

# group: <Func 8> Sheet Memebrane
code_block_78 = CodeBlock { "TargetElements"; }
valueAtKey_15 = DesignScript.Builtin.Dictionary.ValueAtKey(dictionary=value_for_import_from_others_13.MainInput, key=code_block_78)
# note: <Func>
createLeanConcrete_3 = Custom[CreateLeanConcrete](Element=valueAtKey_15)
area_3 = Surface.Area(surface=createLeanConcrete_3.Surface)
code_block_79 = CodeBlock(i=area_3) { Math.Round(List.Flatten(i)/1000000, 2); }
code_block_80 = CodeBlock { "M2"; }
count_14 = List.Count(list=code_block_79)
ofRepeatedItem_13 = List.OfRepeatedItem(item=code_block_80, amount=count_14)
code_block_81 = CodeBlock(FuncValues=code_block_79, FuncValuesUnit=ofRepeatedItem_13)  # same code as code_block_6

# group: <Func 8> Output Manager
output_11 = CodeBlock(MainOutput=code_block_81) { MainOutput; RefOutput_geoColor; }  # unwired: RefOutput_geoColor
reference_output_11 = CodeBlock { ref; }  # unwired: ref

# group: <Func 9> Input Manager
value_for_import_from_others_14 = CodeBlock(MainInput=code_block_23) { MainInput; RefInput1; RefInput2; }  # unwired: RefInput1, RefInput2

# group: <Func 9> Membrane Protection Board (측면 + 상부면 중 pedestal 점유면적 제외)
code_block_82 = CodeBlock { "TargetElements"; }
# note: <Func>
valueAtKey_16 = DesignScript.Builtin.Dictionary.ValueAtKey(dictionary=value_for_import_from_others_14.MainInput, key=code_block_82)
code_block_83 = CodeBlock(Element=valueAtKey_16) { _Element; }
extractUpperFacesOfElement = Custom[ExtractUpperFacesOfElement](Element=code_block_83)  # ExtractUpperFacesOfElement
flatten_20 = List.Flatten(list=extractUpperFacesOfElement.Surface)
getJoinedElements = Element.GetJoinedElements(element=code_block_83)
flatten_21 = List.Flatten(list=getJoinedElements)
extractBelowFacesOfElement = Custom[ExtractBelowFacesOfElement](Element=flatten_21)  # ExtractBelowFacesOfElement
flatten_22 = List.Flatten(list=extractBelowFacesOfElement.Surface)
doesIntersect_2 = Geometry.DoesIntersect(geometry=flatten_22, other=flatten_20, lacing=CrossProduct)
code_block_84 = CodeBlock { true; }
allIndicesOf = List.AllIndicesOf(list=doesIntersect_2@L2, item=code_block_84)
flatten_23 = List.Flatten(list=allIndicesOf)
groupByKey = List.GroupByKey(list=flatten_22, keys=flatten_23)
difference = Surface.Difference(surface=flatten_20, others=groupByKey.groups)
extractSideFacesOfElement_2 = Custom[ExtractSideFacesOfElement](Element=code_block_83)
addItemToFront = List.AddItemToFront(item=difference@L1, list=extractSideFacesOfElement_2.Surface@L2)
area_4 = Surface.Area(surface=addItemToFront)
sum_2 = Math.Sum(values=area_4)
code_block_85 = CodeBlock(i=sum_2) { Math.Round(List.Flatten(i)/1000000, 2); }
code_block_86 = CodeBlock { "M2"; }
count_15 = List.Count(list=code_block_85)
ofRepeatedItem_14 = List.OfRepeatedItem(item=code_block_86, amount=count_15)
code_block_87 = CodeBlock(FuncValues=code_block_85, FuncValuesUnit=ofRepeatedItem_14)  # same code as code_block_6
color_palette_4 = ColorPalette({R: 30, G: 144, B: 255, A: 129})
byGeometryColor_4 = Modifiers.GeometryColor.ByGeometryColor(geometry=addItemToFront, color=color_palette_4)

# group: <Func 9> Output Manager
output_12 = CodeBlock(MainOutput=code_block_87, RefOutput_geoColor=byGeometryColor_4) { MainOutput; RefOutput_geoColor; }
reference_output_12 = CodeBlock { ref; }  # unwired: ref

join = List.Join(list0=output_3.MainOutput, list1=output_5.MainOutput, list2=output_6.MainOutput, list3=output_7.MainOutput, list4=output_8.MainOutput, list5=output_4.MainOutput, list6=output_9.MainOutput, list7=output_10.MainOutput, list8=output_11.MainOutput, list9=output_12.MainOutput)

# group: TargetWMunique + Data Sending
code_block_88 = CodeBlock(InputDic2=join) { _InputDic2; }
count_16 = List.Count(list=code_block_88)
code_block_89 = CodeBlock(InputDic1=code_block_23) { _InputDic1; }
code_block_90 = CodeBlock { "TargetWMunique"; }
valueAtKey_17 = DesignScript.Builtin.Dictionary.ValueAtKey(dictionary=code_block_89, key=code_block_90)
watch_3 = Watch(valueAtKey_17)
count_17 = List.Count(list=watch_3)
eq = count_16 == count_17
organizeFuncValuesAndWorkMasterAsDiction = Custom[OrganizeFuncValuesAndWorkMasterAsDictionary](InputDic1=code_block_89, InputDic2=code_block_88)  # Organize FuncValues and WorkMaster As Dictionary
watch_4 = Watch()  # unwired: arg0
if_4 = If(test=eq, true=organizeFuncValuesAndWorkMasterAsDiction, false=watch_4)

# group: 데이터 취합 및 Row 방향 정렬
code_block_91 = CodeBlock(InputDic=if_4) { _InputDic; }
code_block_92 = CodeBlock { "TrTargetFamilyCode"; }
valueAtKey_18 = DesignScript.Builtin.Dictionary.ValueAtKey(dictionary=code_block_91, key=code_block_92)
watch_5 = Watch(valueAtKey_18)
flatten_24 = List.Flatten(list=watch_5)
code_block_93 = CodeBlock { "WMforTargetElements"; }
valueAtKey_19 = DesignScript.Builtin.Dictionary.ValueAtKey(dictionary=code_block_91, key=code_block_93)
watch_6 = Watch(valueAtKey_19)
flatten_25 = List.Flatten(list=watch_6)
code_block_94 = CodeBlock { "TargetFuncValues"; }
valueAtKey_20 = DesignScript.Builtin.Dictionary.ValueAtKey(dictionary=code_block_91, key=code_block_94)
watch_7 = Watch(valueAtKey_20)
flatten_26 = List.Flatten(list=watch_7)
code_block_95 = CodeBlock { "TargetFuncValuesUnit"; }
valueAtKey_21 = DesignScript.Builtin.Dictionary.ValueAtKey(dictionary=code_block_91, key=code_block_95)
watch_8 = Watch(valueAtKey_21)
flatten_27 = List.Flatten(list=watch_8)
list_create_5 = List.Create(item0=flatten_24, item1=flatten_25, item2=flatten_26, item3=flatten_27)
transpose_5 = List.Transpose(lists=list_create_5)

# group: <Func 1> Visual Manager
visual_켜기_끄기 = BoolSelector(true)
visual_manager = Python(IN[0]=output_5.RefOutput_geoColor, IN[1]=visual_켜기_끄기)  # CPython3
# ---------- visual_manager.python (18 lines) ----------
# Load the Python Standard and DesignScript Libraries
import sys
import clr
clr.AddReference('ProtoGeometry')
from Autodesk.DesignScript.Geometry import *

# The inputs to this node will be stored as a list in the IN variables.
dataEnteringNode = IN
geoColors = IN[0]
blnForVisual = IN[1]

# Place your code below this line
if blnForVisual == True:
    result = geoColors
else:
    result = 0
# Assign your output to the OUT variable.
OUT = result
# ----------------------------------------

# group: <Func 4> Visual Manager
visual_켜기_끄기_2 = BoolSelector(true)
visual_manager_2 = Python(IN[0]=output_8.RefOutput_geoColor, IN[1]=visual_켜기_끄기_2)  # CPython3; same code as visual_manager

# group: <Func 5> Visual Manager
visual_켜기_끄기_3 = BoolSelector(true)
visual_manager_3 = Python(IN[0]=output_4.RefOutput_geoColor, IN[1]=visual_켜기_끄기_3)  # CPython3; same code as visual_manager

# group: <Func 6> Visual Manager
visual_켜기_끄기_4 = BoolSelector(true)
visual_manager_4 = Python(IN[0]=output_9.RefOutput_geoColor, IN[1]=visual_켜기_끄기_4)  # CPython3; same code as visual_manager

# group: <Func 6> Visual Manager
visual_켜기_끄기_5 = BoolSelector(true)
visual_manager_5 = Python(IN[0]=output_12.RefOutput_geoColor, IN[1]=visual_켜기_끄기_5)  # CPython3; same code as visual_manager

# group: Input Manager
value_for_import_from_others_15 = CodeBlock(MainInput=code_block) { MainInput; RefInput1; RefInput2; }  # unwired: RefInput1, RefInput2

# group: <Func 0> Hardner Finish (상부면)
code_block_96 = CodeBlock { "TargetElements"; }
# note: <Func>
valueAtKey_22 = DesignScript.Builtin.Dictionary.ValueAtKey(dictionary=value_for_import_from_others_15.MainInput, key=code_block_96)
flatten_28 = List.Flatten(list=valueAtKey_22)
# note: 일반화 여지가 있음
# (형상처리구간 + 물량계산 + 데이터 매칭)
extractUpperFacesOfElement_2 = Custom[ExtractUpperFacesOfElement](Element=flatten_28)
area_5 = Surface.Area(surface=extractUpperFacesOfElement_2.Surface)
sum_3 = Math.Sum(values=area_5)
code_block_97 = CodeBlock(i=sum_3) { Math.Round(List.Flatten(i)/1000000, 2); }
code_block_98 = CodeBlock { "M2"; }
count_18 = List.Count(list=code_block_97)
ofRepeatedItem_15 = List.OfRepeatedItem(item=code_block_98, amount=count_18)
code_block_99 = CodeBlock(FuncValues=code_block_97, FuncValuesUnit=ofRepeatedItem_15)  # same code as code_block_6
color_palette_5 = ColorPalette({R: 30, G: 144, B: 255, A: 129})
byGeometryColor_5 = Modifiers.GeometryColor.ByGeometryColor(geometry=extractUpperFacesOfElement_2.Surface, color=color_palette_5)

# group: Output Manager
reference_output_13 = CodeBlock { ref; }  # unwired: ref
output_13 = CodeBlock(MainOutput=code_block_99, RefOutput_geoColor=byGeometryColor_5) { MainOutput; RefOutput_geoColor; }

# group: <Func 6> Visual Manager
visual_켜기_끄기_6 = BoolSelector(false)
visual_manager_6 = Python(IN[0]=output_13.RefOutput_geoColor, IN[1]=visual_켜기_끄기_6)  # CPython3; same code as visual_manager

# group: Visual Manager
visual_켜기_끄기_7 = BoolSelector(false)
visual_manager_7 = Python(IN[0]=output_2.RefOutput_geoColor, IN[1]=visual_켜기_끄기_7)  # CPython3; same code as visual_manager

# group: Output Manager
reference_output_14 = CodeBlock { ref; }  # unwired: ref
output_14 = CodeBlock(MainOutput=code_block_22) { MainOutput; RefOutput_geoColor; }  # unwired: RefOutput_geoColor

# group: Visual Manager
visual_켜기_끄기_8 = BoolSelector(false)
visual_manager_8 = Python(IN[0]=output.RefOutput_geoColor, IN[1]=visual_켜기_끄기_8)  # CPython3; same code as visual_manager

# group: Input Manager
value_for_import_from_others_16 = CodeBlock(MainInput=code_block) { MainInput; RefInput1; RefInput2; }  # unwired: RefInput1, RefInput2

# group: <Func 1> Structural Concrete
code_block_100 = CodeBlock { "TargetElements"; }
valueAtKey_23 = DesignScript.Builtin.Dictionary.ValueAtKey(dictionary=value_for_import_from_others_16.MainInput, key=code_block_100)
# note: <Func>
geometry_3 = Element.Geometry(element=valueAtKey_23)
volume_8 = Solid.Volume(solid=geometry_3)
code_block_101 = CodeBlock(i=volume_8) { Math.Round(List.Flatten(i)/1000000000,2); }
code_block_102 = CodeBlock { "M3"; }
count_19 = List.Count(list=code_block_101)
ofRepeatedItem_16 = List.OfRepeatedItem(item=code_block_102, amount=count_19)
code_block_103 = CodeBlock(FuncValues=code_block_101, FuncValuesUnit=ofRepeatedItem_16)  # same code as code_block_6

# group: Output Manager
output_15 = CodeBlock(MainOutput=code_block_103) { MainOutput; RefOutput_geoColor; }  # unwired: RefOutput_geoColor
reference_output_15 = CodeBlock(ref=geometry_3) { ref; }

# group: Input Manager
value_for_import_from_others_17 = CodeBlock(MainInput=code_block) { MainInput; RefInput1; RefInput2; }  # unwired: RefInput1, RefInput2

# group: <Func 2> Form Works (Ground Slab 거푸집 필요X)
code_block_104 = CodeBlock { "TargetElements"; }
valueAtKey_24 = DesignScript.Builtin.Dictionary.ValueAtKey(dictionary=value_for_import_from_others_17.MainInput, key=code_block_104)
code_block_105 = CodeBlock { "Volume"; }
# note: <Func>
getParameterValueByName_6 = Element.GetParameterValueByName(element=valueAtKey_24, parameterName=code_block_105)
code_block_106 = CodeBlock(i=getParameterValueByName_6) { Math.Round(List.Flatten(i)/10000000,2); }
code_block_107 = CodeBlock { "M3"; }
count_20 = List.Count(list=code_block_106)
ofRepeatedItem_17 = List.OfRepeatedItem(item=code_block_107, amount=count_20)
code_block_108 = CodeBlock(FuncValues=code_block_106, FuncValuesUnit=ofRepeatedItem_17)  # same code as code_block_6

# group: Output Manager
reference_output_16 = CodeBlock { ref; }  # unwired: ref
output_16 = CodeBlock(MainOutput=code_block_108) { MainOutput; RefOutput_geoColor; }  # unwired: RefOutput_geoColor

# group: Input Manager
value_for_import_from_others_18 = CodeBlock(MainInput=code_block) { MainInput; RefInput1; RefInput2; }  # unwired: RefInput1, RefInput2

# group: <Func 3> PE Sheet
code_block_109 = CodeBlock { "TargetElements"; }
valueAtKey_25 = DesignScript.Builtin.Dictionary.ValueAtKey(dictionary=value_for_import_from_others_18.MainInput, key=code_block_109)
# note: <Func>
createLeanConcrete_4 = Custom[CreateLeanConcrete](Element=valueAtKey_25)
area_6 = Surface.Area(surface=createLeanConcrete_4.Surface)
code_block_110 = CodeBlock(i=area_6) { Math.Round(List.Flatten(i)/1000000, 2); }
code_block_111 = CodeBlock { "M2"; }
count_21 = List.Count(list=code_block_110)
ofRepeatedItem_18 = List.OfRepeatedItem(item=code_block_111, amount=count_21)
code_block_112 = CodeBlock(FuncValues=code_block_110, FuncValuesUnit=ofRepeatedItem_18)  # same code as code_block_6

# group: Output Manager
reference_output_17 = CodeBlock { ref; }  # unwired: ref
output_17 = CodeBlock(MainOutput=code_block_112) { MainOutput; RefOutput_geoColor; }  # unwired: RefOutput_geoColor

# group: Input Manager
value_for_import_from_others_19 = CodeBlock(MainInput=code_block, RefInput1=reference_output, RefInput2=reference_output_2.ref, RefInput3=reference_output_15) { MainInput; RefInput1; RefInput2; RefInput3; }

# group: <Func 2> Backfill
value_for_import_from_others_20 = CodeBlock(터파기형상=value_for_import_from_others_19.RefInput2) { 터파기형상; }
flatten_29 = List.Flatten(list=value_for_import_from_others_20)
volume_9 = Solid.Volume(solid=flatten_29)
watch_9 = Watch(volume_9)
code_block_113 = CodeBlock(i=watch_9) { Math.Round(List.Flatten(i)/1000000000, 2); }
code_block_114 = CodeBlock { "M3"; }
count_22 = List.Count(list=watch_9)
ofRepeatedItem_19 = List.OfRepeatedItem(item=code_block_114, amount=count_22)
# note: 터파기 물량ㅈ에서 콘크리트, 린 기둥 물량 빼기
code_block_115 = CodeBlock(FuncValues=code_block_113, FuncValuesUnit=ofRepeatedItem_19)  # same code as code_block_6
value_for_import_from_others_21 = CodeBlock(슬라브형상=value_for_import_from_others_19.RefInput3) { 슬라브형상; }
flatten_30 = List.Flatten(list=value_for_import_from_others_21)
doesIntersect_3 = Geometry.DoesIntersect(geometry=flatten_29, other=flatten_30, lacing=CrossProduct)
filterByBoolMask_2 = List.FilterByBoolMask(list=flatten_30, mask=doesIntersect_3@L2)
flatten_31 = List.Flatten(list=filterByBoolMask_2.in)

# group: Output Manager
reference_output_18 = CodeBlock { ref; }  # unwired: ref
output_18 = CodeBlock(MainOutput=code_block_115) { MainOutput; RefOutput_geoColor; }  # unwired: RefOutput_geoColor

# group: Input Manager
value_for_import_from_others_22 = CodeBlock(MainInput=code_block) { MainInput; RefInput1; RefInput2; }  # unwired: RefInput1, RefInput2

# group: <Func 7>Base Course
code_block_116 = CodeBlock { "TargetElements"; }
valueAtKey_26 = DesignScript.Builtin.Dictionary.ValueAtKey(dictionary=value_for_import_from_others_22.MainInput, key=code_block_116)
code_block_117 = CodeBlock { 300; 100; }
# note: <Func>
createBaseCourseSurfaces_2 = Custom[CreateBaseCourseSurfaces](Element=valueAtKey_26, BaseCourseOffsetBottom=code_block_117.out0, leanThick=code_block_117.out1)
area_7 = Surface.Area(surface=createBaseCourseSurfaces_2.Surface)
code_block_118 = CodeBlock(i=area_7) { Math.Round(List.Flatten(i)/1000000, 2); }
code_block_119 = CodeBlock { "M2"; }
count_23 = List.Count(list=code_block_118)
ofRepeatedItem_20 = List.OfRepeatedItem(item=code_block_119, amount=count_23)
code_block_120 = CodeBlock(FuncValues=code_block_118, FuncValuesUnit=ofRepeatedItem_20)  # same code as code_block_6

# group: Output Manager
output_19 = CodeBlock(MainOutput=code_block_120) { MainOutput; RefOutput_geoColor; }  # unwired: RefOutput_geoColor
reference_output_19 = CodeBlock(ref=createBaseCourseSurfaces_2.Surface) { ref; }

# group: Input Manager
value_for_import_from_others_23 = CodeBlock(MainInput=code_block, RefInput1=reference_output_19) { MainInput; RefInput1; RefInput2; }  # unwired: RefInput2

# group: <Func 8>Crushed Stone
code_block_121 = CodeBlock { "TargetElements"; }
valueAtKey_27 = DesignScript.Builtin.Dictionary.ValueAtKey(dictionary=value_for_import_from_others_23.MainInput, key=code_block_121)
# note: <Func>
code_block_122 = CodeBlock { 300; 100; }
createBaseCourseSurfaces_3 = Custom[CreateBaseCourseSurfaces](Element=valueAtKey_27, BaseCourseOffsetBottom=code_block_122.out0, leanThick=code_block_122.out1)
boolean = BoolSelector(false)
thicken = Surface.Thicken(surface=createBaseCourseSurfaces_3.Surface, thickness=code_block_122.out0, both_sides=boolean)
volume_10 = Solid.Volume(solid=thicken)
code_block_123 = CodeBlock(i=volume_10) { Math.Round(List.Flatten(i)/1000000000, 2); }
code_block_124 = CodeBlock { "M3"; }
count_24 = List.Count(list=code_block_123)
ofRepeatedItem_21 = List.OfRepeatedItem(item=code_block_124, amount=count_24)
code_block_125 = CodeBlock(FuncValues=code_block_123, FuncValuesUnit=ofRepeatedItem_21)  # same code as code_block_6

# group: Output Manager
reference_output_20 = CodeBlock { ref; }  # unwired: ref
output_20 = CodeBlock(MainOutput=code_block_125) { MainOutput; RefOutput_geoColor; }  # unwired: RefOutput_geoColor

# group: Input Manager
value_for_import_from_others_24 = CodeBlock(MainInput=code_block) { MainInput; RefInput1; RefInput2; }  # unwired: RefInput1, RefInput2

# group: <Func 10>Rebar Work
code_block_126 = CodeBlock { "TargetElements"; }
valueAtKey_28 = DesignScript.Builtin.Dictionary.ValueAtKey(dictionary=value_for_import_from_others_24.MainInput, key=code_block_126)
code_block_127 = CodeBlock { "Volume"; }
# note: <Func>
getParameterValueByName_7 = Element.GetParameterValueByName(element=valueAtKey_28, parameterName=code_block_127)
sog_철근비 = DoubleInput(0)  # graph input
mul_2 = getParameterValueByName_7 * sog_철근비
code_block_128 = CodeBlock(i=mul_2) { Math.Round(List.Flatten(i)/1, 2); }
code_block_129 = CodeBlock { "TON"; }
count_25 = List.Count(list=code_block_128)
ofRepeatedItem_22 = List.OfRepeatedItem(item=code_block_129, amount=count_25)
code_block_130 = CodeBlock(FuncValues=code_block_128, FuncValuesUnit=ofRepeatedItem_22)  # same code as code_block_6

# group: Output Manager
reference_output_21 = CodeBlock { ref; }  # unwired: ref
output_21 = CodeBlock(MainOutput=code_block_130) { MainOutput; RefOutput_geoColor; }  # unwired: RefOutput_geoColor

join_2 = List.Join(list0=output_13.MainOutput, list1=output_15.MainOutput, list2=output_16.MainOutput, list3=output_17.MainOutput, list4=output_2.MainOutput, list5=output_18.MainOutput, list6=output_14.MainOutput, list7=output_19.MainOutput, list8=output_20.MainOutput, list9=output.MainOutput, list10=output_21.MainOutput)
watch_10 = Watch(output_2.MainOutput)
code_block_131 = CodeBlock { i; }  # unwired: i

# group: Input Manager
value_for_import_from_others_25 = CodeBlock(MainInput=code_block_131) { MainInput; RefInput1; RefInput2; }  # unwired: RefInput1, RefInput2

# group: <Func 9>Lean Concrete
code_block_132 = CodeBlock { "TargetElements"; }
valueAtKey_29 = DesignScript.Builtin.Dictionary.ValueAtKey(dictionary=value_for_import_from_others_25.MainInput, key=code_block_132)
code_block_133 = CodeBlock { 0; 100; }
# note: <Func>
createLeanConcrete_5 = Custom[CreateLeanConcrete](Element=valueAtKey_29, leanOffset=code_block_133.out0, leanThick=code_block_133.out1)
volume_11 = Solid.Volume(solid=createLeanConcrete_5.Solid)
code_block_134 = CodeBlock(i=volume_11) { Math.Round(List.Flatten(i)/1000000000, 2); }
code_block_135 = CodeBlock { "M3"; }
count_26 = List.Count(list=code_block_134)
ofRepeatedItem_23 = List.OfRepeatedItem(item=code_block_135, amount=count_26)
code_block_136 = CodeBlock(FuncValues=code_block_134, FuncValuesUnit=ofRepeatedItem_23)  # same code as code_block_6

# group: Output Manager
reference_output_22 = CodeBlock(ref=createLeanConcrete_5.Solid) { ref; }
output_22 = CodeBlock(MainOutput=code_block_136, RefOutput_geoColor=createLeanConcrete_5.Solid) { MainOutput; RefOutput_geoColor; }

# group: Input Manager
value_for_import_from_others_26 = CodeBlock(MainInput=code_block_131, RefInput1=reference_output_22) { MainInput; RefInput1; RefInput2; }  # unwired: RefInput2

# group: <Func 4> Excavation (SOG 한정)
flatten_32 = List.Flatten(list=value_for_import_from_others_26.RefInput1)
하부_surface_추출_5 = Python(IN[0]=flatten_32)  # CPython3; same code as 하부_surface_추출
flatten_33 = List.Flatten(list=하부_surface_추출_5)
perimeterCurves_4 = Surface.PerimeterCurves(surface=flatten_33)
byJoinedCurves_4 = PolyCurve.ByJoinedCurves(curves=perimeterCurves_4)
code_block_137 = CodeBlock { _ExcavOffsetBottom: var[]..[] = 300; }
offset_7 = Curve.Offset(curve=byJoinedCurves_4, distance=code_block_137)
flatten_34 = List.Flatten(list=offset_7)
levels_4 = Levels("G.L")  # graph input
elevation_4 = Level.Elevation(level=levels_4)
code_block_138 = CodeBlock { "TargetElements"; }
valueAtKey_30 = DesignScript.Builtin.Dictionary.ValueAtKey(dictionary=value_for_import_from_others_26.MainInput, key=code_block_138)
code_block_139 = CodeBlock { "Elevation at Bottom"; }
getParameterValueByName_8 = Element.GetParameterValueByName(element=valueAtKey_30, parameterName=code_block_139)
린_콘크리트_하부까지의_길이_추출_최하단_4 = Python(IN[0]=value_for_import_from_others_26.RefInput1)  # CPython3; same code as 린_콘크리트_하부까지의_길이_추출_최하단
code_block_140 = CodeBlock(기초하단=getParameterValueByName_8, 린콘크리트하단=린_콘크리트_하부까지의_길이_추출_최하단_4) { 기초하단-린콘크리트하단; }
sub_4 = elevation_4 - code_block_140
flatten_35 = List.Flatten(list=sub_4)
translate_4 = Geometry.Translate(geometry=offset_7, zTranslation=flatten_35)
경사_비율_입력_1_x_for_isofdn_3 = DoubleInput(2)  # graph input
code_block_141 = CodeBlock(ElevationatBottom=flatten_35, 비율=경사_비율_입력_1_x_for_isofdn_3) { ElevationatBottom/비율; }
offset_8 = Curve.Offset(curve=translate_4, distance=code_block_141)
flatten_36 = List.Flatten(list=offset_8)
list_create_6 = List.Create(item0=flatten_34, item1=flatten_36)
transpose_6 = List.Transpose(lists=list_create_6)
byLoft_4 = Solid.ByLoft(crossSections=transpose_6)
터파기_형상_겹침_해소_4 = Python(IN[0]=byLoft_4)  # CPython3; same code as 터파기_형상_겹침_해소
code_block_142 = CodeBlock(i=sub_4) { i<0?true:false; }
code_block_143 = CodeBlock { 0; }
volume_12 = Solid.Volume(solid=터파기_형상_겹침_해소_4)
code_block_144 = CodeBlock(i=volume_12) { Math.Round(List.Flatten(i)/1000000000, 2); }
if_5 = If(test=code_block_142, true=code_block_143, false=code_block_144)
code_block_145 = CodeBlock { "M3"; }
count_27 = List.Count(list=code_block_144)
ofRepeatedItem_24 = List.OfRepeatedItem(item=code_block_145, amount=count_27)
code_block_146 = CodeBlock(FuncValues=if_5, FuncValuesUnit=ofRepeatedItem_24)  # same code as code_block_6
color_palette_6 = ColorPalette({R: 210, G: 105, B: 30, A: 135})
byGeometryColor_6 = Modifiers.GeometryColor.ByGeometryColor(geometry=터파기_형상_겹침_해소_4, color=color_palette_6)
forRefOutput_4 = CodeBlock(MainOutput=code_block_146, geoColor=byGeometryColor_6, 터파기형상=터파기_형상_겹침_해소_4)  # same code as forRefOutput

# group: Output Manager
reference_output_23 = CodeBlock(ref=터파기_형상_겹침_해소_4, ref2=if_5) { ref; ref2; }
output_23 = CodeBlock(MainOutput=forRefOutput_4, RefOutput_geoColor=byGeometryColor_6) { MainOutput; RefOutput_geoColor; }

# group: Input Manager
value_for_import_from_others_27 = CodeBlock(MainInput=code_block_131, RefInput1=reference_output_23.ref2) { MainInput; RefInput1; RefInput2; }  # unwired: RefInput2

# group: <Func 6>Disposal
code_block_147 = CodeBlock { "TargetElements"; }
valueAtKey_31 = DesignScript.Builtin.Dictionary.ValueAtKey(dictionary=value_for_import_from_others_27.MainInput, key=code_block_147)
count_28 = List.Count(list=valueAtKey_31@L1)
code_block_148 = CodeBlock(i=value_for_import_from_others_27.RefInput1) { i==0?true:false; }
code_block_149 = CodeBlock { 0; }
# note: <Func>
if_6 = If(test=code_block_148, true=code_block_149, false=value_for_import_from_others_27.RefInput1)
code_block_150 = CodeBlock(i=if_6) { Math.Round(List.Flatten(i)/1000000000, 2); }
code_block_151 = CodeBlock { "M3"; }
count_29 = List.Count(list=code_block_150)
ofRepeatedItem_25 = List.OfRepeatedItem(item=code_block_151, amount=count_29)
code_block_152 = CodeBlock(FuncValues=code_block_150, FuncValuesUnit=ofRepeatedItem_25)  # same code as code_block_6

# group: Input Manager
value_for_import_from_others_28 = CodeBlock(MainInput=code_block_131) { MainInput; RefInput1; RefInput2; }  # unwired: RefInput1, RefInput2

# group: <Func 0> Hardner Finish (상부면)
code_block_153 = CodeBlock { "TargetElements"; }
# note: <Func>
valueAtKey_32 = DesignScript.Builtin.Dictionary.ValueAtKey(dictionary=value_for_import_from_others_28.MainInput, key=code_block_153)
flatten_37 = List.Flatten(list=valueAtKey_32)
# note: 일반화 여지가 있음
# (형상처리구간 + 물량계산 + 데이터 매칭)
extractUpperFacesOfElement_3 = Custom[ExtractUpperFacesOfElement](Element=flatten_37)
area_8 = Surface.Area(surface=extractUpperFacesOfElement_3.Surface)
sum_4 = Math.Sum(values=area_8)
code_block_154 = CodeBlock(i=sum_4) { Math.Round(List.Flatten(i)/1000000, 2); }
code_block_155 = CodeBlock { "M2"; }
count_30 = List.Count(list=code_block_154)
ofRepeatedItem_26 = List.OfRepeatedItem(item=code_block_155, amount=count_30)
code_block_156 = CodeBlock(FuncValues=code_block_154, FuncValuesUnit=ofRepeatedItem_26)  # same code as code_block_6
color_palette_7 = ColorPalette({R: 30, G: 144, B: 255, A: 129})
byGeometryColor_7 = Modifiers.GeometryColor.ByGeometryColor(geometry=extractUpperFacesOfElement_3.Surface, color=color_palette_7)

# group: Output Manager
reference_output_24 = CodeBlock { ref; }  # unwired: ref
output_24 = CodeBlock(MainOutput=code_block_156, RefOutput_geoColor=byGeometryColor_7) { MainOutput; RefOutput_geoColor; }

# group: <Func 6> Visual Manager
visual_켜기_끄기_9 = BoolSelector(false)
visual_manager_9 = Python(IN[0]=output_24.RefOutput_geoColor, IN[1]=visual_켜기_끄기_9)  # CPython3; same code as visual_manager

# group: Visual Manager
visual_켜기_끄기_10 = BoolSelector(false)
visual_manager_10 = Python(IN[0]=output_23.RefOutput_geoColor, IN[1]=visual_켜기_끄기_10)  # CPython3; same code as visual_manager

# group: Output Manager
reference_output_25 = CodeBlock { ref; }  # unwired: ref
output_25 = CodeBlock(MainOutput=code_block_152) { MainOutput; RefOutput_geoColor; }  # unwired: RefOutput_geoColor

# group: Input Manager
value_for_import_from_others_29 = CodeBlock(MainInput=code_block_131) { MainInput; RefInput1; RefInput2; }  # unwired: RefInput1, RefInput2

# group: <Func 1> Structural Concrete
code_block_157 = CodeBlock { "TargetElements"; }
valueAtKey_33 = DesignScript.Builtin.Dictionary.ValueAtKey(dictionary=value_for_import_from_others_29.MainInput, key=code_block_157)
# note: <Func>
geometry_4 = Element.Geometry(element=valueAtKey_33)
volume_13 = Solid.Volume(solid=geometry_4)
code_block_158 = CodeBlock(i=volume_13) { Math.Round(List.Flatten(i)/1000000000,2); }
code_block_159 = CodeBlock { "M3"; }
count_31 = List.Count(list=code_block_158)
ofRepeatedItem_27 = List.OfRepeatedItem(item=code_block_159, amount=count_31)
code_block_160 = CodeBlock(FuncValues=code_block_158, FuncValuesUnit=ofRepeatedItem_27)  # same code as code_block_6

# group: Output Manager
reference_output_26 = CodeBlock(ref=geometry_4) { ref; }
output_26 = CodeBlock(MainOutput=code_block_160) { MainOutput; RefOutput_geoColor; }  # unwired: RefOutput_geoColor

# group: Input Manager
value_for_import_from_others_30 = CodeBlock(MainInput=code_block_131, RefInput1=reference_output_22, RefInput2=reference_output_23.ref, RefInput3=reference_output_26) { MainInput; RefInput1; RefInput2; RefInput3; }

# group: <Func 2> Backfill
value_for_import_from_others_31 = CodeBlock(슬라브형상=value_for_import_from_others_30.RefInput3) { 슬라브형상; }
flatten_38 = List.Flatten(list=value_for_import_from_others_31)
value_for_import_from_others_32 = CodeBlock(터파기형상=value_for_import_from_others_30.RefInput2) { 터파기형상; }
flatten_39 = List.Flatten(list=value_for_import_from_others_32)
doesIntersect_4 = Geometry.DoesIntersect(geometry=flatten_39, other=flatten_38, lacing=CrossProduct)
filterByBoolMask_3 = List.FilterByBoolMask(list=flatten_38, mask=doesIntersect_4@L2)
flatten_40 = List.Flatten(list=filterByBoolMask_3.in)
volume_14 = Solid.Volume(solid=flatten_39)
watch_11 = Watch(volume_14)
code_block_161 = CodeBlock(i=watch_11) { Math.Round(List.Flatten(i)/1000000000, 2); }
code_block_162 = CodeBlock { "M3"; }
count_32 = List.Count(list=watch_11)
ofRepeatedItem_28 = List.OfRepeatedItem(item=code_block_162, amount=count_32)
# note: 터파기 물량ㅈ에서 콘크리트, 린 기둥 물량 빼기
code_block_163 = CodeBlock(FuncValues=code_block_161, FuncValuesUnit=ofRepeatedItem_28)  # same code as code_block_6

# group: Output Manager
reference_output_27 = CodeBlock { ref; }  # unwired: ref
output_27 = CodeBlock(MainOutput=code_block_163) { MainOutput; RefOutput_geoColor; }  # unwired: RefOutput_geoColor

watch_12 = Watch(output_23.MainOutput)

# group: Visual Manager
visual_켜기_끄기_11 = BoolSelector(false)
visual_manager_11 = Python(IN[0]=output_22.RefOutput_geoColor, IN[1]=visual_켜기_끄기_11)  # CPython3; same code as visual_manager

# group: Input Manager
value_for_import_from_others_33 = CodeBlock(MainInput=code_block_131) { MainInput; RefInput1; RefInput2; }  # unwired: RefInput1, RefInput2

# group: <Func 2> Form Works (Ground Slab 거푸집 필요X)
code_block_164 = CodeBlock { "TargetElements"; }
valueAtKey_34 = DesignScript.Builtin.Dictionary.ValueAtKey(dictionary=value_for_import_from_others_33.MainInput, key=code_block_164)
code_block_165 = CodeBlock { "Volume"; }
# note: <Func>
getParameterValueByName_9 = Element.GetParameterValueByName(element=valueAtKey_34, parameterName=code_block_165)
code_block_166 = CodeBlock(i=getParameterValueByName_9) { Math.Round(List.Flatten(i)/10000000,2); }
code_block_167 = CodeBlock { "M3"; }
count_33 = List.Count(list=code_block_166)
ofRepeatedItem_29 = List.OfRepeatedItem(item=code_block_167, amount=count_33)
code_block_168 = CodeBlock(FuncValues=code_block_166, FuncValuesUnit=ofRepeatedItem_29)  # same code as code_block_6

# group: Output Manager
reference_output_28 = CodeBlock { ref; }  # unwired: ref
output_28 = CodeBlock(MainOutput=code_block_168) { MainOutput; RefOutput_geoColor; }  # unwired: RefOutput_geoColor

# group: Input Manager
value_for_import_from_others_34 = CodeBlock(MainInput=code_block_131) { MainInput; RefInput1; RefInput2; }  # unwired: RefInput1, RefInput2

# group: <Func 3> PE Sheet
code_block_169 = CodeBlock { "TargetElements"; }
valueAtKey_35 = DesignScript.Builtin.Dictionary.ValueAtKey(dictionary=value_for_import_from_others_34.MainInput, key=code_block_169)
# note: <Func>
createLeanConcrete_6 = Custom[CreateLeanConcrete](Element=valueAtKey_35)
area_9 = Surface.Area(surface=createLeanConcrete_6.Surface)
code_block_170 = CodeBlock(i=area_9) { Math.Round(List.Flatten(i)/1000000, 2); }
code_block_171 = CodeBlock { "M2"; }
count_34 = List.Count(list=code_block_170)
ofRepeatedItem_30 = List.OfRepeatedItem(item=code_block_171, amount=count_34)
code_block_172 = CodeBlock(FuncValues=code_block_170, FuncValuesUnit=ofRepeatedItem_30)  # same code as code_block_6

# group: Output Manager
reference_output_29 = CodeBlock { ref; }  # unwired: ref
output_29 = CodeBlock(MainOutput=code_block_172) { MainOutput; RefOutput_geoColor; }  # unwired: RefOutput_geoColor

# group: Input Manager
value_for_import_from_others_35 = CodeBlock(MainInput=code_block_131) { MainInput; RefInput1; RefInput2; }  # unwired: RefInput1, RefInput2

# group: <Func 7>Base Course
code_block_173 = CodeBlock { "TargetElements"; }
valueAtKey_36 = DesignScript.Builtin.Dictionary.ValueAtKey(dictionary=value_for_import_from_others_35.MainInput, key=code_block_173)
code_block_174 = CodeBlock { 300; 100; }
# note: <Func>
createBaseCourseSurfaces_4 = Custom[CreateBaseCourseSurfaces](Element=valueAtKey_36, BaseCourseOffsetBottom=code_block_174.out0, leanThick=code_block_174.out1)
area_10 = Surface.Area(surface=createBaseCourseSurfaces_4.Surface)
code_block_175 = CodeBlock(i=area_10) { Math.Round(List.Flatten(i)/1000000, 2); }
code_block_176 = CodeBlock { "M2"; }
count_35 = List.Count(list=code_block_175)
ofRepeatedItem_31 = List.OfRepeatedItem(item=code_block_176, amount=count_35)
code_block_177 = CodeBlock(FuncValues=code_block_175, FuncValuesUnit=ofRepeatedItem_31)  # same code as code_block_6

# group: Output Manager
output_30 = CodeBlock(MainOutput=code_block_177) { MainOutput; RefOutput_geoColor; }  # unwired: RefOutput_geoColor
reference_output_30 = CodeBlock(ref=createBaseCourseSurfaces_4.Surface) { ref; }

# group: Input Manager
value_for_import_from_others_36 = CodeBlock(MainInput=code_block_131, RefInput1=reference_output_30) { MainInput; RefInput1; RefInput2; }  # unwired: RefInput2

# group: <Func 8>Crushed Stone
code_block_178 = CodeBlock { "TargetElements"; }
valueAtKey_37 = DesignScript.Builtin.Dictionary.ValueAtKey(dictionary=value_for_import_from_others_36.MainInput, key=code_block_178)
# note: <Func>
code_block_179 = CodeBlock { 300; 100; }
createBaseCourseSurfaces_5 = Custom[CreateBaseCourseSurfaces](Element=valueAtKey_37, BaseCourseOffsetBottom=code_block_179.out0, leanThick=code_block_179.out1)
boolean_2 = BoolSelector(false)
thicken_2 = Surface.Thicken(surface=createBaseCourseSurfaces_5.Surface, thickness=code_block_179.out0, both_sides=boolean_2)
volume_15 = Solid.Volume(solid=thicken_2)
code_block_180 = CodeBlock(i=volume_15) { Math.Round(List.Flatten(i)/1000000000, 2); }
code_block_181 = CodeBlock { "M3"; }
count_36 = List.Count(list=code_block_180)
ofRepeatedItem_32 = List.OfRepeatedItem(item=code_block_181, amount=count_36)
code_block_182 = CodeBlock(FuncValues=code_block_180, FuncValuesUnit=ofRepeatedItem_32)  # same code as code_block_6

# group: Output Manager
reference_output_31 = CodeBlock { ref; }  # unwired: ref
output_31 = CodeBlock(MainOutput=code_block_182) { MainOutput; RefOutput_geoColor; }  # unwired: RefOutput_geoColor

# group: Input Manager
value_for_import_from_others_37 = CodeBlock(MainInput=code_block_131) { MainInput; RefInput1; RefInput2; }  # unwired: RefInput1, RefInput2

# group: <Func 10>Rebar Work
code_block_183 = CodeBlock { "TargetElements"; }
valueAtKey_38 = DesignScript.Builtin.Dictionary.ValueAtKey(dictionary=value_for_import_from_others_37.MainInput, key=code_block_183)
code_block_184 = CodeBlock { "Volume"; }
# note: <Func>
getParameterValueByName_10 = Element.GetParameterValueByName(element=valueAtKey_38, parameterName=code_block_184)
sog_철근비_2 = DoubleInput(0)  # graph input
mul_3 = getParameterValueByName_10 * sog_철근비_2
code_block_185 = CodeBlock(i=mul_3) { Math.Round(List.Flatten(i)/1, 2); }
code_block_186 = CodeBlock { "TON"; }
count_37 = List.Count(list=code_block_185)
ofRepeatedItem_33 = List.OfRepeatedItem(item=code_block_186, amount=count_37)
code_block_187 = CodeBlock(FuncValues=code_block_185, FuncValuesUnit=ofRepeatedItem_33)  # same code as code_block_6

# group: Output Manager
reference_output_32 = CodeBlock { ref; }  # unwired: ref
output_32 = CodeBlock(MainOutput=code_block_187) { MainOutput; RefOutput_geoColor; }  # unwired: RefOutput_geoColor

join_3 = List.Join(list0=output_24.MainOutput, list1=output_26.MainOutput, list2=output_28.MainOutput, list3=output_29.MainOutput, list4=output_23.MainOutput, list5=output_27.MainOutput, list6=output_25.MainOutput, list7=output_30.MainOutput, list8=output_31.MainOutput, list9=output_22.MainOutput, list10=output_32.MainOutput)

# group: Primary Input : Excel & Revit Elements
categories_2 = Categories("OST_StructuralFoundation")
all_elements_of_category_2 = ElementsOfCategory(Category=categories_2)
string_from_web = Python()  # CPython3; unwired: IN[0]
# ---------- string_from_web.python (19 lines) ----------
# Load the Python Standard and DesignScript Libraries
import sys
import clr
clr.AddReference('ProtoGeometry')
from Autodesk.DesignScript.Geometry import *
import urllib.request

# The inputs to this node will be stored as a list in the IN variables.
dataEnteringNode = IN
inputURL = "https://raw.githubusercontent.com/HNANmal/mQ/master/Hdynlib/General/ImportExcel.py"

# Place your code below this line
req = urllib.request
data = req.urlopen(inputURL)

result = data.read().decode("utf-8")

# Assign your output to the OUT variable.
OUT = result
# ----------------------------------------
file_path = Filename("..\..\220110\DMS(Data Matching Schedule)_R0(Seq2)_220110.xlsx")  # graph input
sheet_name = CodeBlock { "Str Foundations"; }
github_python_import_excel_by = PythonStringNode(script=string_from_web, IN[0]=file_path, IN[1]=sheet_name)  # "Github_Python@Import Excel(By OpenpyXl)"; CPython3
code_block_188 = CodeBlock(InputElement=all_elements_of_category_2, InputData=github_python_import_excel_by) { _InputElement; _InputData; }

# group: GetFull WMCodeDescription PerElement
excelDataManagerNode = Python(IN[0]=code_block_188._InputElement, IN[1]=code_block_188._InputData)  # CPython3
# ---------- excelDataManagerNode.python (279 lines) ----------
# Load the Python Standard and DesignScript Libraries
import os
import sys
sys.path.append(os.getenv('LOCALAPPDATA').replace('\\','\\\\') + r'\Programs\Python\Python39\Lib\site-packages')
import clr
clr.AddReference('RevitAPI')
import Autodesk

clr.AddReference('ProtoGeometry')
from Autodesk.DesignScript.Geometry import *

clr.AddReference('RevitNodes')
import Revit
clr.ImportExtensions(Revit.Elements)

clr.ImportExtensions(Revit.GeometryConversion)
clr.ImportExtensions(Revit.GeometryReferences)

clr.AddReference('RevitServices')
import RevitServices
from RevitServices.Persistence import DocumentManager
from RevitServices.Transactions import TransactionManager

doc = DocumentManager.Instance.CurrentDBDocument

import random
import itertools
from functools import reduce
from collections import Iterable
import datetime
import openpyxl

def iterable(obj):
    return isinstance(obj, Iterable)

def findUnique(inputs):
    result = []
    for i in inputs:
        if i in result:
            pass
        else:
            result.append(i)
    return result

# The inputs to this node will be stored as a list in the IN variables.
dataEnteringNode = IN
inputElements = IN[0]
inputData = IN[1]
#inputSheetName = IN[2]

def importExcel(path, SheetNameIn):
    wb_obj = openpyxl.load_workbook(str(path), data_only=True)
    sheet_obj = wb_obj.get_sheet_by_name(str(SheetNameIn))

    m_row = sheet_obj.max_row
    m_col = sheet_obj.max_column

    listOut = []

    for i in range(1, m_row +1):
        listTemp = []
        for j in range(1, m_col + 1):
            cell_obj = sheet_obj.cell(row=i, column=j)
            listTemp.append(cell_obj.value)
            if len(listTemp) == m_col:
                listOut.append(listTemp)
    return listOut

def getUsedFamilyTypeOfModeling(elements):
    familyCode = list(map(lambda x: x.Name.split('_')[0], elements))
    unq_familyCode = findUnique(familyCode)
    return unq_familyCode
    
def createExcelDataDictionary(values):
    result = {}
    for i in range(len(values)):
        result[str(i)] = values[i]
    return result

def findTargetIndex(targets, list):
    result = []
    for target in targets:
        for i in range(len(list)):
            if target in str(list[i]):
                result.append(i)
            else:
                pass
    result.sort()
    return result
    
def GetValueAtKeys(keys, dictionary):
    result = [] 
    for i in keys:
        result.append(dictionary[str(i)])
    return result


# Place your code below this line
usedFamilyTypeOfModeling = getUsedFamilyTypeOfModeling(inputElements)
excelWholeDataSet = inputData#importExcel(inputFilePath, inputSheetName)
trExcelWholeDataSet = list(zip(*excelWholeDataSet))
excelColumnDataSet = createExcelDataDictionary(trExcelWholeDataSet)
excelRowDataSet = createExcelDataDictionary(excelWholeDataSet)
ColumnIndexOfUsedFamilyType = findTargetIndex(usedFamilyTypeOfModeling, trExcelWholeDataSet)
ColDataSetOfUsedFamilyType = GetValueAtKeys(ColumnIndexOfUsedFamilyType, excelColumnDataSet)
materialPerElementFromModeling = []
for i in inputElements:
    materialPerElementFromModeling.append(i.GetMaterials())
#list(map(lambda x: x.GetMaterials, inputElements)) "맵함수로 처리하면 리스트화 할 때 타입 변환 오류 남"

targetWMRowIndex = []
for i in ColDataSetOfUsedFamilyType:
    targetWMRowIndex.append(findTargetIndex(['000'], i))

rowDataSetOfUsedWM = []
for i in targetWMRowIndex:
    rowDataSetOfUsedWM.append(GetValueAtKeys(i, excelRowDataSet))

workGroup = []
for i in rowDataSetOfUsedWM:
    tmp = []
    for j in i:
        tmp.append(j[0])
    workGroup.append(tmp)
    
workMaster = []
for i in range(len(ColDataSetOfUsedFamilyType)):
    tmp=[]
    for k in targetWMRowIndex[i]:
        tmp.append(ColDataSetOfUsedFamilyType[i][k])
    workMaster.append(tmp)

matchedWM = []
for i in range(len(workGroup)):
    tmp = []
    for j in range(len(workGroup[i])):
        fullWM = workGroup[i][j] +"-"+ workMaster[i][j]
        tmp.append(fullWM)
    matchedWM.append(tmp)

matchedWorkGruopAndMasterCode = []
for i in matchedWM:
    if len(i) > 0:
        matchedWorkGruopAndMasterCode.append(i)
    else:
        pass

matchedWMDescription = []
for i in rowDataSetOfUsedWM:
    tmp=[]
    for j in i:
        tmp.append(j[1] +" "+ j[2] +" "+ j[3] +" "+ "("+ j[4] +")")
    if len(tmp) > 0:
        matchedWMDescription.append(tmp)
    else:
        pass

matchedWMUnit = []
for i in rowDataSetOfUsedWM:
    tmp=[]
    for j in i:
        tmp.append(j[4])
    if len(tmp) > 0:
        matchedWMUnit.append(tmp)
    else:
        pass

matchedWorkGruopAndMasterCode_flat = list(itertools.chain(*matchedWorkGruopAndMasterCode))
matchedWMDescription_flat = list(itertools.chain(*matchedWMDescription))

dic_WMandDescription_Excel = {}
for i in range(len(matchedWorkGruopAndMasterCode_flat)):
    dic_WMandDescription_Excel[matchedWorkGruopAndMasterCode_flat[i]] = matchedWMDescription_flat[i]

usedFamilyTypeInExcelOrder = list(map(lambda x: x[3], ColDataSetOfUsedFamilyType))
usedFamilyCodeInExcelOrder = findUnique(list(map(lambda x: x.split('_')[0], usedFamilyTypeInExcelOrder)))

dic_FamilyCodeandWM = {}
for i in range(len(usedFamilyCodeInExcelOrder)):
    dic_FamilyCodeandWM[usedFamilyCodeInExcelOrder[i]] = matchedWorkGruopAndMasterCode[i]

workMasterCodePerElement = []
familyCodePerElem = list(map(lambda x: x.Name.split('_')[0], inputElements))
for i in familyCodePerElem:
    workMasterCodePerElement.append(dic_FamilyCodeandWM[i])

materialNamePerElem = []
for i in materialPerElementFromModeling:
    tmp = []
    for j in i:
        tmp.append(j.Name)
    materialNamePerElem.append(tmp)

WMPerElementFromModeling = []
for i in materialNamePerElem:
    tmp = []
    for j in i:
        tmp.append(j.split('_')[0])
    WMPerElementFromModeling.append(tmp)

specPerElementFromModeling = []
for i in materialNamePerElem:
    tmp = []
    for j in i:
        a = j.split('_')
        del a[0]
        b = " ".join(a)
        tmp.append(b)
    specPerElementFromModeling.append(tmp)

WMPerElementFromModeling_flat = list(itertools.chain(*WMPerElementFromModeling))
specPerElementFromModeling_flat = list(itertools.chain(*specPerElementFromModeling))

dic_WMandDescription_Model = {}
for i in range(len(WMPerElementFromModeling_flat)):
    dic_WMandDescription_Model[WMPerElementFromModeling_flat[i]] = specPerElementFromModeling_flat[i]

def findAllKeys(dict):
    result = []
    for key in dict.keys():
        result.append(key)
    return result

def findAllValues(dict):
    result = []
    for key in dict.keys():
        result.append(dict[key])
    return result

keys_WMandDescription_Model = findAllKeys(dic_WMandDescription_Model)
keys_WMandDescription_Excel = findAllKeys(dic_WMandDescription_Excel)

keys_WMandDescription_Both = list(set(keys_WMandDescription_Model + keys_WMandDescription_Excel))
values_WMandDescription_Both = []
for i in keys_WMandDescription_Both:
    if i in keys_WMandDescription_Model:
        values_WMandDescription_Both.append(dic_WMandDescription_Model[i])
    else:
        values_WMandDescription_Both.append(dic_WMandDescription_Excel[i])

dic_WMandDescription_Both = {}
for i in range(len(keys_WMandDescription_Both)):
    dic_WMandDescription_Both[keys_WMandDescription_Both[i]] = values_WMandDescription_Both[i]

workMasterCodePerElementFromBoth = []
for i in range(len(workMasterCodePerElement)):
    #tmp = []
    a = WMPerElementFromModeling[i] + workMasterCodePerElement[i]
    b = findUnique(a)
    workMasterCodePerElementFromBoth.append(b)

specPerElement = []
for i in workMasterCodePerElementFromBoth:
    tmp = []
    for j in i:
        tmp.append(dic_WMandDescription_Both[j])
    specPerElement.append(tmp)

fullWMCodeDescriptionPerElement = []
for i in range(len(workMasterCodePerElementFromBoth)):
    tmp = []
    for j in range(len(workMasterCodePerElementFromBoth[i])):
        a = workMasterCodePerElementFromBoth[i][j] +": "+ specPerElement[i][j]
        tmp.append(a)
    fullWMCodeDescriptionPerElement.append(tmp)

fullWMinfo = {
"AllElement": inputElements,
"WorkMasterCodePerFamilyType": dic_FamilyCodeandWM,
"WorkMasterCodePerElementBoth": workMasterCodePerElementFromBoth,
"FullWMCodeDescriptionPerElement": fullWMCodeDescriptionPerElement
}



result = fullWMinfo

# Assign your output to the OUT variable.
OUT = result
# ----------------------------------------

# group: Organize AllElementInform AsDictionary
set_up_all_element_inform_as = Python(IN[0]=excelDataManagerNode)  # "Set Up All Element Inform as Dictionary"; CPython3
# ---------- set_up_all_element_inform_as.python (119 lines) ----------
# Load the Python Standard and DesignScript Libraries
import os
import sys
sys.path.append(os.getenv('LOCALAPPDATA').replace('\\','\\\\') + r'\Programs\Python\Python39\Lib\site-packages')
import clr
clr.AddReference('RevitAPI')
import Autodesk

clr.AddReference('ProtoGeometry')
from Autodesk.DesignScript.Geometry import *

clr.AddReference('RevitNodes')
import Revit
clr.ImportExtensions(Revit.Elements)

clr.ImportExtensions(Revit.GeometryConversion)
clr.ImportExtensions(Revit.GeometryReferences)

clr.AddReference('RevitServices')
import RevitServices
from RevitServices.Persistence import DocumentManager
from RevitServices.Transactions import TransactionManager

doc = DocumentManager.Instance.CurrentDBDocument

import random
import itertools
from functools import reduce
from collections import Iterable
import datetime
import openpyxl

def iterable(obj):
    return isinstance(obj, Iterable)

def findUnique(inputs):
    result = []
    for i in inputs:
        if i in result:
            pass
        else:
            result.append(i)
    return result

# The inputs to this node will be stored as a list in the IN variables.
dataEnteringNode = IN
inputDict = IN[0]


def importExcel(path, SheetNameIn):
    wb_obj = openpyxl.load_workbook(str(path), data_only=True)
    sheet_obj = wb_obj.get_sheet_by_name(str(SheetNameIn))

    m_row = sheet_obj.max_row
    m_col = sheet_obj.max_column

    listOut = []

    for i in range(1, m_row +1):
        listTemp = []
        for j in range(1, m_col + 1):
            cell_obj = sheet_obj.cell(row=i, column=j)
            listTemp.append(cell_obj.value)
            if len(listTemp) == m_col:
                listOut.append(listTemp)
    return listOut

def getUsedFamilyTypeOfModeling(elements):
    familyCode = list(map(lambda x: x.Name.split('_')[0], elements))
    unq_familyCode = findUnique(familyCode)
    return unq_familyCode
    
def createExcelDataDictionary(values):
    result = {}
    for i in range(len(values)):
        result[str(i)] = values[i]
    return result

def findTargetIndex(targets, list):
    result = []
    for target in targets:
        for i in range(len(list)):
            if target in str(list[i]):
                result.append(i)
            else:
                pass
    result.sort()
    return result
    
def GetValueAtKeys(keys, dictionary):
    result = [] 
    for i in keys:
        result.append(dictionary[str(i)])
    return result


# Place your code below this line
element = inputDict["AllElement"]
elementType = []
for i in element:
    elementType.append(i.Name)
familyCode = []
for i in elementType:
    familyCode.append(i.split("_")[0])
fullWMCodeDescriptionPerElement = inputDict["FullWMCodeDescriptionPerElement"]

resultDict = {
"Element": element,
"ElementType": elementType,
"FamilyCode": familyCode,
"FullWMCodeDescriptionPerElement": fullWMCodeDescriptionPerElement
}



result = resultDict

# Assign your output to the OUT variable.
OUT = result
# ----------------------------------------

# group: Select Target Family Element And Connected WorkMasters
code_block_189 = CodeBlock { 0; }
select_target_family_element_and = Python(IN[0]=set_up_all_element_inform_as, IN[1]=code_block_189)  # "Select Target Family Element And Connected WorkMasters"; CPython3
# ---------- select_target_family_element_and.python (138 lines) ----------
# Load the Python Standard and DesignScript Libraries
import os
import sys
sys.path.append(os.getenv('LOCALAPPDATA').replace('\\','\\\\') + r'\Programs\Python\Python39\Lib\site-packages')
import clr
clr.AddReference('RevitAPI')
import Autodesk

clr.AddReference('ProtoGeometry')
from Autodesk.DesignScript.Geometry import *

clr.AddReference('RevitNodes')
import Revit
clr.ImportExtensions(Revit.Elements)

clr.ImportExtensions(Revit.GeometryConversion)
clr.ImportExtensions(Revit.GeometryReferences)

clr.AddReference('RevitServices')
import RevitServices
from RevitServices.Persistence import DocumentManager
from RevitServices.Transactions import TransactionManager

doc = DocumentManager.Instance.CurrentDBDocument

import random
import itertools
from functools import reduce
from collections import Iterable
import datetime
import openpyxl

def iterable(obj):
    return isinstance(obj, Iterable)

def findUnique(inputs):
    result = []
    for i in inputs:
        if i in result:
            pass
        else:
            result.append(i)
    return result

# The inputs to this node will be stored as a list in the IN variables.
dataEnteringNode = IN
inputDict = IN[0]
inputIndex = IN[1]


def importExcel(path, SheetNameIn):
    wb_obj = openpyxl.load_workbook(str(path), data_only=True)
    sheet_obj = wb_obj.get_sheet_by_name(str(SheetNameIn))

    m_row = sheet_obj.max_row
    m_col = sheet_obj.max_column

    listOut = []

    for i in range(1, m_row +1):
        listTemp = []
        for j in range(1, m_col + 1):
            cell_obj = sheet_obj.cell(row=i, column=j)
            listTemp.append(cell_obj.value)
            if len(listTemp) == m_col:
                listOut.append(listTemp)
    return listOut

def getUsedFamilyTypeOfModeling(elements):
    familyCode = list(map(lambda x: x.Name.split('_')[0], elements))
    unq_familyCode = findUnique(familyCode)
    return unq_familyCode
    
def createExcelDataDictionary(values):
    result = {}
    for i in range(len(values)):
        result[str(i)] = values[i]
    return result

def findTargetIndex(targets, list):
    result = []
    for target in targets:
        for i in range(len(list)):
            if target in str(list[i]):
                result.append(i)
            else:
                pass
    result.sort()
    return result
    
def GetValueAtKeys(keys, dictionary):
    result = [] 
    for i in keys:
        result.append(dictionary[str(i)])
    return result


# Place your code below this line
fullWMCodeDescriptionPerElement = inputDict["FullWMCodeDescriptionPerElement"]
element = inputDict["Element"]
familyCode = inputDict["FamilyCode"]
familyCode_unique = findUnique(familyCode)
targetFamilyCode = familyCode_unique[inputIndex]
targetIndex = []
for i in range(len(familyCode)):
    if targetFamilyCode in familyCode[i]:
        targetIndex.append(i)
    else:
        pass

targetElements = []
for i in targetIndex:
    targetElements.append(element[i])

targetFamilyCode = []
for i in targetIndex:
    targetFamilyCode.append(element[i].Name)

WMforTargetElements = []
for i in targetIndex:
    WMforTargetElements.append(fullWMCodeDescriptionPerElement[i])

WMforTargetElements_flat = list(itertools.chain(*WMforTargetElements))
targetWMunique = findUnique(WMforTargetElements_flat)

resultDict = {
"TargetElements": targetElements,
"TargetFamilyCode": targetFamilyCode,
"WMforTargetElements": WMforTargetElements,
"TargetWMunique": targetWMunique
}



result = resultDict

# Assign your output to the OUT variable.
OUT = result
# ----------------------------------------

watch_13 = Watch(select_target_family_element_and)

# group: Select Target Family Element And Connected WorkMasters
code_block_190 = CodeBlock { 1; }
select_target_family_element_and_2 = Python(IN[0]=set_up_all_element_inform_as, IN[1]=code_block_190)  # "Select Target Family Element And Connected WorkMasters"; CPython3; same code as select_target_family_element_and

watch_14 = Watch(select_target_family_element_and_2)

# group: 사용된 패밀리 타입 종류 확인 구간
code_block_191 = CodeBlock { "ElementType"; }
valueAtKey_39 = DesignScript.Builtin.Dictionary.ValueAtKey(dictionary=set_up_all_element_inform_as, key=code_block_191)
uniqueItems_2 = List.UniqueItems(list=valueAtKey_39)
watch_15 = Watch(uniqueItems_2)
code_block_192 = CodeBlock { "FamilyCode"; }
valueAtKey_40 = DesignScript.Builtin.Dictionary.ValueAtKey(dictionary=set_up_all_element_inform_as, key=code_block_192)
uniqueItems_3 = List.UniqueItems(list=valueAtKey_40)
watch_16 = Watch(uniqueItems_3)

code_block_193 = CodeBlock { i; }  # unwired: i
code_block_194 = CodeBlock(i=code_block_193) { i; }

# group: Input Manager
value_for_import_from_others_38 = CodeBlock(MainInput=code_block_194) { MainInput; RefInput1; RefInput2; }  # unwired: RefInput1, RefInput2

# group: <Func 9>Lean Concrete
code_block_195 = CodeBlock { "TargetElements"; }
valueAtKey_41 = DesignScript.Builtin.Dictionary.ValueAtKey(dictionary=value_for_import_from_others_38.MainInput, key=code_block_195)
code_block_196 = CodeBlock { 0; 100; }
# note: <Func>
createLeanConcrete_7 = Custom[CreateLeanConcrete](Element=valueAtKey_41, leanOffset=code_block_196.out0, leanThick=code_block_196.out1)
volume_16 = Solid.Volume(solid=createLeanConcrete_7.Solid)
code_block_197 = CodeBlock(i=volume_16) { Math.Round(List.Flatten(i)/1000000000, 2); }
code_block_198 = CodeBlock { "M3"; }
count_38 = List.Count(list=code_block_197)
ofRepeatedItem_34 = List.OfRepeatedItem(item=code_block_198, amount=count_38)
code_block_199 = CodeBlock(FuncValues=code_block_197, FuncValuesUnit=ofRepeatedItem_34)  # same code as code_block_6

# group: Output Manager
reference_output_33 = CodeBlock(ref=createLeanConcrete_7.Solid) { ref; }
output_33 = CodeBlock(MainOutput=code_block_199, RefOutput_geoColor=createLeanConcrete_7.Solid) { MainOutput; RefOutput_geoColor; }

# group: Input Manager
value_for_import_from_others_39 = CodeBlock(MainInput=code_block_194, RefInput1=reference_output_33) { MainInput; RefInput1; RefInput2; }  # unwired: RefInput2

# group: <Func 4> Excavation (SOG 한정)
levels_5 = Levels("G.L")  # graph input
elevation_5 = Level.Elevation(level=levels_5)
code_block_200 = CodeBlock { "TargetElements"; }
valueAtKey_42 = DesignScript.Builtin.Dictionary.ValueAtKey(dictionary=value_for_import_from_others_39.MainInput, key=code_block_200)
code_block_201 = CodeBlock { "Elevation at Bottom"; }
getParameterValueByName_11 = Element.GetParameterValueByName(element=valueAtKey_42, parameterName=code_block_201)
린_콘크리트_하부까지의_길이_추출_최하단_5 = Python(IN[0]=value_for_import_from_others_39.RefInput1)  # CPython3; same code as 린_콘크리트_하부까지의_길이_추출_최하단
code_block_202 = CodeBlock(기초하단=getParameterValueByName_11, 린콘크리트하단=린_콘크리트_하부까지의_길이_추출_최하단_5) { 기초하단-린콘크리트하단; }
sub_5 = elevation_5 - code_block_202
code_block_203 = CodeBlock(i=sub_5) { i<0?true:false; }
code_block_204 = CodeBlock { 0; }
flatten_41 = List.Flatten(list=value_for_import_from_others_39.RefInput1)
하부_surface_추출_6 = Python(IN[0]=flatten_41)  # CPython3; same code as 하부_surface_추출
flatten_42 = List.Flatten(list=하부_surface_추출_6)
perimeterCurves_5 = Surface.PerimeterCurves(surface=flatten_42)
byJoinedCurves_5 = PolyCurve.ByJoinedCurves(curves=perimeterCurves_5)
code_block_205 = CodeBlock { _ExcavOffsetBottom: var[]..[] = 300; }
offset_9 = Curve.Offset(curve=byJoinedCurves_5, distance=code_block_205)
flatten_43 = List.Flatten(list=offset_9)
flatten_44 = List.Flatten(list=sub_5)
translate_5 = Geometry.Translate(geometry=offset_9, zTranslation=flatten_44)
경사_비율_입력_1_x_for_isofdn_4 = DoubleInput(2)  # graph input
code_block_206 = CodeBlock(ElevationatBottom=flatten_44, 비율=경사_비율_입력_1_x_for_isofdn_4) { ElevationatBottom/비율; }
offset_10 = Curve.Offset(curve=translate_5, distance=code_block_206)
flatten_45 = List.Flatten(list=offset_10)
list_create_7 = List.Create(item0=flatten_43, item1=flatten_45)
transpose_7 = List.Transpose(lists=list_create_7)
byLoft_5 = Solid.ByLoft(crossSections=transpose_7)
터파기_형상_겹침_해소_5 = Python(IN[0]=byLoft_5)  # CPython3; same code as 터파기_형상_겹침_해소
volume_17 = Solid.Volume(solid=터파기_형상_겹침_해소_5)
code_block_207 = CodeBlock(i=volume_17) { Math.Round(List.Flatten(i)/1000000000, 2); }
if_7 = If(test=code_block_203, true=code_block_204, false=code_block_207)
code_block_208 = CodeBlock { "M3"; }
count_39 = List.Count(list=code_block_207)
ofRepeatedItem_35 = List.OfRepeatedItem(item=code_block_208, amount=count_39)
code_block_209 = CodeBlock(FuncValues=if_7, FuncValuesUnit=ofRepeatedItem_35)  # same code as code_block_6
color_palette_8 = ColorPalette({R: 210, G: 105, B: 30, A: 135})
byGeometryColor_8 = Modifiers.GeometryColor.ByGeometryColor(geometry=터파기_형상_겹침_해소_5, color=color_palette_8)
forRefOutput_5 = CodeBlock(MainOutput=code_block_209, geoColor=byGeometryColor_8, 터파기형상=터파기_형상_겹침_해소_5)  # same code as forRefOutput

# group: Output Manager
output_34 = CodeBlock(MainOutput=forRefOutput_5, RefOutput_geoColor=byGeometryColor_8) { MainOutput; RefOutput_geoColor; }
reference_output_34 = CodeBlock(ref=터파기_형상_겹침_해소_5, ref2=if_7) { ref; ref2; }

# group: Visual Manager
visual_켜기_끄기_12 = BoolSelector(false)
visual_manager_12 = Python(IN[0]=output_34.RefOutput_geoColor, IN[1]=visual_켜기_끄기_12)  # CPython3; same code as visual_manager

# group: Visual Manager
visual_켜기_끄기_13 = BoolSelector(false)
visual_manager_13 = Python(IN[0]=output_33.RefOutput_geoColor, IN[1]=visual_켜기_끄기_13)  # CPython3; same code as visual_manager

# group: Input Manager
value_for_import_from_others_40 = CodeBlock(MainInput=code_block_194) { MainInput; RefInput1; RefInput2; }  # unwired: RefInput1, RefInput2

# group: <Func 0> Hardner Finish (상부면)
code_block_210 = CodeBlock { "TargetElements"; }
# note: <Func>
valueAtKey_43 = DesignScript.Builtin.Dictionary.ValueAtKey(dictionary=value_for_import_from_others_40.MainInput, key=code_block_210)
flatten_46 = List.Flatten(list=valueAtKey_43)
# note: 일반화 여지가 있음
# (형상처리구간 + 물량계산 + 데이터 매칭)
extractUpperFacesOfElement_4 = Custom[ExtractUpperFacesOfElement](Element=flatten_46)
area_11 = Surface.Area(surface=extractUpperFacesOfElement_4.Surface)
sum_5 = Math.Sum(values=area_11)
code_block_211 = CodeBlock(i=sum_5) { Math.Round(List.Flatten(i)/1000000, 2); }
code_block_212 = CodeBlock { "M2"; }
count_40 = List.Count(list=code_block_211)
ofRepeatedItem_36 = List.OfRepeatedItem(item=code_block_212, amount=count_40)
code_block_213 = CodeBlock(FuncValues=code_block_211, FuncValuesUnit=ofRepeatedItem_36)  # same code as code_block_6
color_palette_9 = ColorPalette({R: 30, G: 144, B: 255, A: 129})
byGeometryColor_9 = Modifiers.GeometryColor.ByGeometryColor(geometry=extractUpperFacesOfElement_4.Surface, color=color_palette_9)

# group: Output Manager
output_35 = CodeBlock(MainOutput=code_block_213, RefOutput_geoColor=byGeometryColor_9) { MainOutput; RefOutput_geoColor; }
reference_output_35 = CodeBlock { ref; }  # unwired: ref

# group: Input Manager
value_for_import_from_others_41 = CodeBlock(MainInput=code_block_194) { MainInput; RefInput1; RefInput2; }  # unwired: RefInput1, RefInput2

# group: <Func 1> Structural Concrete
code_block_214 = CodeBlock { "TargetElements"; }
valueAtKey_44 = DesignScript.Builtin.Dictionary.ValueAtKey(dictionary=value_for_import_from_others_41.MainInput, key=code_block_214)
# note: <Func>
geometry_5 = Element.Geometry(element=valueAtKey_44)
volume_18 = Solid.Volume(solid=geometry_5)
code_block_215 = CodeBlock(i=volume_18) { Math.Round(List.Flatten(i)/1000000000,2); }
code_block_216 = CodeBlock { "M3"; }
count_41 = List.Count(list=code_block_215)
ofRepeatedItem_37 = List.OfRepeatedItem(item=code_block_216, amount=count_41)
code_block_217 = CodeBlock(FuncValues=code_block_215, FuncValuesUnit=ofRepeatedItem_37)  # same code as code_block_6

# group: Output Manager
output_36 = CodeBlock(MainOutput=code_block_217) { MainOutput; RefOutput_geoColor; }  # unwired: RefOutput_geoColor
reference_output_36 = CodeBlock(ref=geometry_5) { ref; }

# group: Input Manager
value_for_import_from_others_42 = CodeBlock(MainInput=code_block_194) { MainInput; RefInput1; RefInput2; }  # unwired: RefInput1, RefInput2

# group: <Func 2> Form Works (Ground Slab 거푸집 필요X)
code_block_218 = CodeBlock { "TargetElements"; }
valueAtKey_45 = DesignScript.Builtin.Dictionary.ValueAtKey(dictionary=value_for_import_from_others_42.MainInput, key=code_block_218)
code_block_219 = CodeBlock { "Volume"; }
# note: <Func>
getParameterValueByName_12 = Element.GetParameterValueByName(element=valueAtKey_45, parameterName=code_block_219)
code_block_220 = CodeBlock(i=getParameterValueByName_12) { Math.Round(List.Flatten(i)/10000000,2); }
code_block_221 = CodeBlock { "M3"; }
count_42 = List.Count(list=code_block_220)
ofRepeatedItem_38 = List.OfRepeatedItem(item=code_block_221, amount=count_42)
code_block_222 = CodeBlock(FuncValues=code_block_220, FuncValuesUnit=ofRepeatedItem_38)  # same code as code_block_6

# group: Output Manager
output_37 = CodeBlock(MainOutput=code_block_222) { MainOutput; RefOutput_geoColor; }  # unwired: RefOutput_geoColor
reference_output_37 = CodeBlock { ref; }  # unwired: ref

# group: Input Manager
value_for_import_from_others_43 = CodeBlock(MainInput=code_block_194) { MainInput; RefInput1; RefInput2; }  # unwired: RefInput1, RefInput2

# group: <Func 3> PE Sheet
code_block_223 = CodeBlock { "TargetElements"; }
valueAtKey_46 = DesignScript.Builtin.Dictionary.ValueAtKey(dictionary=value_for_import_from_others_43.MainInput, key=code_block_223)
# note: <Func>
createLeanConcrete_8 = Custom[CreateLeanConcrete](Element=valueAtKey_46)
area_12 = Surface.Area(surface=createLeanConcrete_8.Surface)
code_block_224 = CodeBlock(i=area_12) { Math.Round(List.Flatten(i)/1000000, 2); }
code_block_225 = CodeBlock { "M2"; }
count_43 = List.Count(list=code_block_224)
ofRepeatedItem_39 = List.OfRepeatedItem(item=code_block_225, amount=count_43)
code_block_226 = CodeBlock(FuncValues=code_block_224, FuncValuesUnit=ofRepeatedItem_39)  # same code as code_block_6

# group: Output Manager
output_38 = CodeBlock(MainOutput=code_block_226) { MainOutput; RefOutput_geoColor; }  # unwired: RefOutput_geoColor
reference_output_38 = CodeBlock { ref; }  # unwired: ref

# group: Input Manager
value_for_import_from_others_44 = CodeBlock(MainInput=code_block_194, RefInput1=reference_output_33, RefInput2=reference_output_34.ref, RefInput3=reference_output_36) { MainInput; RefInput1; RefInput2; RefInput3; }

# group: <Func 5> Backfill
value_for_import_from_others_45 = CodeBlock(터파기형상=value_for_import_from_others_44.RefInput2) { 터파기형상; }
flatten_47 = List.Flatten(list=value_for_import_from_others_45)
volume_19 = Solid.Volume(solid=flatten_47)
watch_17 = Watch(volume_19)
code_block_227 = CodeBlock(i=watch_17) { Math.Round(List.Flatten(i)/1000000000, 2); }
code_block_228 = CodeBlock { "M3"; }
count_44 = List.Count(list=watch_17)
ofRepeatedItem_40 = List.OfRepeatedItem(item=code_block_228, amount=count_44)
# note: 터파기 물량ㅈ에서 콘크리트, 린 기둥 물량 빼기
code_block_229 = CodeBlock(FuncValues=code_block_227, FuncValuesUnit=ofRepeatedItem_40)  # same code as code_block_6
value_for_import_from_others_46 = CodeBlock(슬라브형상=value_for_import_from_others_44.RefInput3) { 슬라브형상; }
flatten_48 = List.Flatten(list=value_for_import_from_others_46)
doesIntersect_5 = Geometry.DoesIntersect(geometry=flatten_47, other=flatten_48, lacing=CrossProduct)
filterByBoolMask_4 = List.FilterByBoolMask(list=flatten_48, mask=doesIntersect_5@L2)
flatten_49 = List.Flatten(list=filterByBoolMask_4.in)

# group: Output Manager
output_39 = CodeBlock(MainOutput=code_block_229) { MainOutput; RefOutput_geoColor; }  # unwired: RefOutput_geoColor
reference_output_39 = CodeBlock { ref; }  # unwired: ref

# group: Input Manager
value_for_import_from_others_47 = CodeBlock(MainInput=code_block_194, RefInput1=reference_output_34.ref2) { MainInput; RefInput1; RefInput2; }  # unwired: RefInput2

# group: <Func 6>Disposal
code_block_230 = CodeBlock(i=value_for_import_from_others_47.RefInput1) { i==0?true:false; }
code_block_231 = CodeBlock { 0; }
# note: <Func>
if_8 = If(test=code_block_230, true=code_block_231, false=value_for_import_from_others_47.RefInput1)
code_block_232 = CodeBlock(i=if_8) { Math.Round(List.Flatten(i)/1000000000, 2); }
code_block_233 = CodeBlock { "M3"; }
count_45 = List.Count(list=code_block_232)
ofRepeatedItem_41 = List.OfRepeatedItem(item=code_block_233, amount=count_45)
code_block_234 = CodeBlock(FuncValues=code_block_232, FuncValuesUnit=ofRepeatedItem_41)  # same code as code_block_6
code_block_235 = CodeBlock { "TargetElements"; }
valueAtKey_47 = DesignScript.Builtin.Dictionary.ValueAtKey(dictionary=value_for_import_from_others_47.MainInput, key=code_block_235)
count_46 = List.Count(list=valueAtKey_47@L1)

# group: Output Manager
output_40 = CodeBlock(MainOutput=code_block_234) { MainOutput; RefOutput_geoColor; }  # unwired: RefOutput_geoColor
reference_output_40 = CodeBlock { ref; }  # unwired: ref

# group: Input Manager
value_for_import_from_others_48 = CodeBlock(MainInput=code_block_194) { MainInput; RefInput1; RefInput2; }  # unwired: RefInput1, RefInput2

# group: <Func 7>Base Course
code_block_236 = CodeBlock { "TargetElements"; }
valueAtKey_48 = DesignScript.Builtin.Dictionary.ValueAtKey(dictionary=value_for_import_from_others_48.MainInput, key=code_block_236)
code_block_237 = CodeBlock { 300; 100; }
# note: <Func>
createBaseCourseSurfaces_6 = Custom[CreateBaseCourseSurfaces](Element=valueAtKey_48, BaseCourseOffsetBottom=code_block_237.out0, leanThick=code_block_237.out1)
area_13 = Surface.Area(surface=createBaseCourseSurfaces_6.Surface)
code_block_238 = CodeBlock(i=area_13) { Math.Round(List.Flatten(i)/1000000, 2); }
code_block_239 = CodeBlock { "M2"; }
count_47 = List.Count(list=code_block_238)
ofRepeatedItem_42 = List.OfRepeatedItem(item=code_block_239, amount=count_47)
code_block_240 = CodeBlock(FuncValues=code_block_238, FuncValuesUnit=ofRepeatedItem_42)  # same code as code_block_6

# group: Output Manager
output_41 = CodeBlock(MainOutput=code_block_240) { MainOutput; RefOutput_geoColor; }  # unwired: RefOutput_geoColor
reference_output_41 = CodeBlock(ref=createBaseCourseSurfaces_6.Surface) { ref; }

# group: Input Manager
value_for_import_from_others_49 = CodeBlock(MainInput=code_block_194, RefInput1=reference_output_41) { MainInput; RefInput1; RefInput2; }  # unwired: RefInput2

# group: <Func 8>Crushed Stone
code_block_241 = CodeBlock { "TargetElements"; }
valueAtKey_49 = DesignScript.Builtin.Dictionary.ValueAtKey(dictionary=value_for_import_from_others_49.MainInput, key=code_block_241)
# note: <Func>
code_block_242 = CodeBlock { 300; 100; }
createBaseCourseSurfaces_7 = Custom[CreateBaseCourseSurfaces](Element=valueAtKey_49, BaseCourseOffsetBottom=code_block_242.out0, leanThick=code_block_242.out1)
boolean_3 = BoolSelector(false)
thicken_3 = Surface.Thicken(surface=createBaseCourseSurfaces_7.Surface, thickness=code_block_242.out0, both_sides=boolean_3)
volume_20 = Solid.Volume(solid=thicken_3)
code_block_243 = CodeBlock(i=volume_20) { Math.Round(List.Flatten(i)/1000000000, 2); }
code_block_244 = CodeBlock { "M3"; }
count_48 = List.Count(list=code_block_243)
ofRepeatedItem_43 = List.OfRepeatedItem(item=code_block_244, amount=count_48)
code_block_245 = CodeBlock(FuncValues=code_block_243, FuncValuesUnit=ofRepeatedItem_43)  # same code as code_block_6

# group: Output Manager
output_42 = CodeBlock(MainOutput=code_block_245) { MainOutput; RefOutput_geoColor; }  # unwired: RefOutput_geoColor
reference_output_42 = CodeBlock { ref; }  # unwired: ref

# group: Input Manager
value_for_import_from_others_50 = CodeBlock(MainInput=code_block_194) { MainInput; RefInput1; RefInput2; }  # unwired: RefInput1, RefInput2

# group: <Func 10>Rebar Work
code_block_246 = CodeBlock { "TargetElements"; }
valueAtKey_50 = DesignScript.Builtin.Dictionary.ValueAtKey(dictionary=value_for_import_from_others_50.MainInput, key=code_block_246)
code_block_247 = CodeBlock { "Volume"; }
# note: <Func>
getParameterValueByName_13 = Element.GetParameterValueByName(element=valueAtKey_50, parameterName=code_block_247)
sog_철근비_3 = DoubleInput(0)  # graph input
mul_4 = getParameterValueByName_13 * sog_철근비_3
code_block_248 = CodeBlock(i=mul_4) { Math.Round(List.Flatten(i)/1, 2); }
code_block_249 = CodeBlock { "TON"; }
count_49 = List.Count(list=code_block_248)
ofRepeatedItem_44 = List.OfRepeatedItem(item=code_block_249, amount=count_49)
code_block_250 = CodeBlock(FuncValues=code_block_248, FuncValuesUnit=ofRepeatedItem_44)  # same code as code_block_6

# group: Output Manager
output_43 = CodeBlock(MainOutput=code_block_250) { MainOutput; RefOutput_geoColor; }  # unwired: RefOutput_geoColor
reference_output_43 = CodeBlock { ref; }  # unwired: ref

join_4 = List.Join(list0=output_35.MainOutput, list1=output_36.MainOutput, list2=output_37.MainOutput, list3=output_38.MainOutput, list4=output_34.MainOutput, list5=output_39.MainOutput, list6=output_40.MainOutput, list7=output_41.MainOutput, list8=output_42.MainOutput, list9=output_33.MainOutput, list10=output_43.MainOutput)

# group: TargetWMunique + Data Sending
code_block_251 = CodeBlock(InputDic2=join_4) { _InputDic2; }
count_50 = List.Count(list=code_block_251)
code_block_252 = CodeBlock(InputDic1=code_block_193) { _InputDic1; }
code_block_253 = CodeBlock { "TargetWMunique"; }
valueAtKey_51 = DesignScript.Builtin.Dictionary.ValueAtKey(dictionary=code_block_252, key=code_block_253)
watch_18 = Watch(valueAtKey_51)
count_51 = List.Count(list=watch_18)
eq_2 = count_50 == count_51
organizeFuncValuesAndWorkMasterAsDiction_2 = Custom[OrganizeFuncValuesAndWorkMasterAsDictionary](InputDic1=code_block_252, InputDic2=code_block_251)
watch_19 = Watch()  # unwired: arg0
if_9 = If(test=eq_2, true=organizeFuncValuesAndWorkMasterAsDiction_2, false=watch_19)

watch_20 = Watch(output_34.MainOutput)

# group: <Func 6> Visual Manager
visual_켜기_끄기_14 = BoolSelector(false)
visual_manager_14 = Python(IN[0]=output_35.RefOutput_geoColor, IN[1]=visual_켜기_끄기_14)  # CPython3; same code as visual_manager

# group: Select Target Family Element And Connected WorkMasters
code_block_254 = CodeBlock { 2; }
select_target_family_element_and_3 = Python(IN[0]=set_up_all_element_inform_as, IN[1]=code_block_254)  # "Select Target Family Element And Connected WorkMasters"; CPython3; same code as select_target_family_element_and

watch_21 = Watch(select_target_family_element_and_3)

# group: Select Target Family Element And Connected WorkMasters
code_block_255 = CodeBlock { 3; }
select_target_family_element_and_4 = Python(IN[0]=set_up_all_element_inform_as, IN[1]=code_block_255)  # "Select Target Family Element And Connected WorkMasters"; CPython3; same code as select_target_family_element_and

watch_22 = Watch(select_target_family_element_and_4)

# group: Input Manager
value_for_import_from_others_51 = CodeBlock(MainInput=code_block_23) { MainInput; RefInput1; RefInput2; }  # unwired: RefInput1, RefInput2

# group: <Func 00>Crushed Stone
code_block_256 = CodeBlock { "TargetElements"; }
valueAtKey_52 = DesignScript.Builtin.Dictionary.ValueAtKey(dictionary=value_for_import_from_others_51.MainInput, key=code_block_256)
# note: <Func>
code_block_257 = CodeBlock { 300; 100; }
createBaseCourseSurfaces_8 = Custom[CreateBaseCourseSurfaces](Element=valueAtKey_52, BaseCourseOffsetBottom=code_block_257.out0, leanThick=code_block_257.out1)
boolean_4 = BoolSelector(false)
thicken_4 = Surface.Thicken(surface=createBaseCourseSurfaces_8.Surface, thickness=code_block_257.out0, both_sides=boolean_4)
volume_21 = Solid.Volume(solid=thicken_4)
code_block_258 = CodeBlock(i=volume_21) { Math.Round(List.Flatten(i)/1000000000, 2); }
code_block_259 = CodeBlock { "M3"; }
count_52 = List.Count(list=code_block_258)
ofRepeatedItem_45 = List.OfRepeatedItem(item=code_block_259, amount=count_52)
code_block_260 = CodeBlock(FuncValues=code_block_258, FuncValuesUnit=ofRepeatedItem_45)  # same code as code_block_6

# group: Output Manager
output_44 = CodeBlock(MainOutput=code_block_260) { MainOutput; RefOutput_geoColor; }  # unwired: RefOutput_geoColor
reference_output_44 = CodeBlock { ref; }  # unwired: ref

# group: Primary Input : Excel & Revit Elements
categories_3 = Categories("OST_EdgeSlab")
all_elements_of_category_3 = ElementsOfCategory(Category=categories_3)
string_from_web_2 = Python()  # CPython3; unwired: IN[0]; same code as string_from_web
file_path_2 = Filename("..\DMS(Data Matching Schedule)_R0(Seq1-2).xlsx")  # graph input
sheet_name_2 = CodeBlock { "Slab Edges"; }
github_python_import_excel_by_2 = PythonStringNode(script=string_from_web_2, IN[0]=file_path_2, IN[1]=sheet_name_2)  # "Github_Python@Import Excel(By OpenpyXl)"; CPython3
code_block_261 = CodeBlock(InputElement=all_elements_of_category_3, InputData=github_python_import_excel_by_2) { _InputElement; _InputData; }

# group: GetFull WMCodeDescription PerElement
excelDataManagerNode_2 = Python(IN[0]=code_block_261._InputElement, IN[1]=code_block_261._InputData)  # CPython3; same code as excelDataManagerNode

# group: Organize AllElementInform AsDictionary
set_up_all_element_inform_as_2 = Python(IN[0]=excelDataManagerNode_2)  # "Set Up All Element Inform as Dictionary"; CPython3; same code as set_up_all_element_inform_as

# group: 사용된 패밀리 타입 종류 확인 구간
code_block_262 = CodeBlock { "FamilyCode"; }
valueAtKey_53 = DesignScript.Builtin.Dictionary.ValueAtKey(dictionary=set_up_all_element_inform_as_2, key=code_block_262)
uniqueItems_4 = List.UniqueItems(list=valueAtKey_53)
watch_23 = Watch(uniqueItems_4)
code_block_263 = CodeBlock { "ElementType"; }
valueAtKey_54 = DesignScript.Builtin.Dictionary.ValueAtKey(dictionary=set_up_all_element_inform_as_2, key=code_block_263)
uniqueItems_5 = List.UniqueItems(list=valueAtKey_54)
watch_24 = Watch(uniqueItems_5)

# group: Select Target Family Element And Connected WorkMasters
code_block_264 = CodeBlock { 0; }
select_target_family_element_and_5 = Python(IN[0]=set_up_all_element_inform_as_2, IN[1]=code_block_264)  # "Select Target Family Element And Connected WorkMasters"; CPython3; same code as select_target_family_element_and

watch_25 = Watch(select_target_family_element_and_5)
code_block_265 = CodeBlock { i; }  # unwired: i

# group: Input Manager
value_for_import_from_others_52 = CodeBlock(MainInput=code_block_265) { MainInput; RefInput1; RefInput2; }  # unwired: RefInput1, RefInput2

# group: <Func 1> Structural Concrete
code_block_266 = CodeBlock { "TargetElements"; }
valueAtKey_55 = DesignScript.Builtin.Dictionary.ValueAtKey(dictionary=value_for_import_from_others_52.MainInput, key=code_block_266)
# note: <Func>
geometry_6 = Element.Geometry(element=valueAtKey_55)
volume_22 = Solid.Volume(solid=geometry_6)
code_block_267 = CodeBlock(i=volume_22) { Math.Round(List.Flatten(i)/1000000000,2); }
code_block_268 = CodeBlock { "M3"; }
count_53 = List.Count(list=code_block_267)
ofRepeatedItem_46 = List.OfRepeatedItem(item=code_block_268, amount=count_53)
code_block_269 = CodeBlock(FuncValues=code_block_267, FuncValuesUnit=ofRepeatedItem_46)  # same code as code_block_6

# group: Output Manager
output_45 = CodeBlock(MainOutput=code_block_269) { MainOutput; RefOutput_geoColor; }  # unwired: RefOutput_geoColor
reference_output_45 = CodeBlock(ref=geometry_6) { ref; }

# group: Input Manager
value_for_import_from_others_53 = CodeBlock(MainInput=code_block_265) { MainInput; RefInput1; RefInput2; }  # unwired: RefInput1, RefInput2

# group: <Func 5> Form Works (Ground Slab 거푸집 필요X)
code_block_270 = CodeBlock { "TargetElements"; }
# note: <Func>
valueAtKey_56 = DesignScript.Builtin.Dictionary.ValueAtKey(dictionary=value_for_import_from_others_53.MainInput, key=code_block_270)
code_block_271 = CodeBlock { "M2"; }
extractSideFacesOfElement_3 = Custom[ExtractSideFacesOfElement](Element=valueAtKey_56)
area_14 = Surface.Area(surface=extractSideFacesOfElement_3.Surface)
sum_6 = Math.Sum(values=area_14)

# group (continued): <Func 5> Form Works (Ground Slab 거푸집 필요X)
code_block_272 = CodeBlock(i=sum_6) { Math.Round(List.Flatten(i)/1000000,2); }
count_54 = List.Count(list=code_block_272)
ofRepeatedItem_47 = List.OfRepeatedItem(item=code_block_271, amount=count_54)
code_block_273 = CodeBlock(FuncValues=code_block_272, FuncValuesUnit=ofRepeatedItem_47)  # same code as code_block_6

# group: Output Manager
output_46 = CodeBlock(MainOutput=code_block_273) { MainOutput; RefOutput_geoColor; }  # unwired: RefOutput_geoColor
reference_output_46 = CodeBlock { ref; }  # unwired: ref

# group: Input Manager
value_for_import_from_others_54 = CodeBlock(MainInput=code_block_265) { MainInput; RefInput1; RefInput2; }  # unwired: RefInput1, RefInput2

# group: <Func 2> Excavation for Slab edge (ratio 1.1 적용)
code_block_274 = CodeBlock { "TargetElements"; }
valueAtKey_57 = DesignScript.Builtin.Dictionary.ValueAtKey(dictionary=value_for_import_from_others_54.MainInput, key=code_block_274)

code_block_275 = CodeBlock { "Volume"; }
getParameterValueByName_14 = Element.GetParameterValueByName(element=valueAtKey_57, parameterName=code_block_275)
code_block_276 = CodeBlock(i=getParameterValueByName_14) { Math.Round(List.Flatten(i)*1.1, 2); }
code_block_277 = CodeBlock { "M3"; }
count_55 = List.Count(list=code_block_276)
ofRepeatedItem_48 = List.OfRepeatedItem(item=code_block_277, amount=count_55)
code_block_278 = CodeBlock(FuncValues=code_block_276, FuncValuesUnit=ofRepeatedItem_48)  # same code as code_block_6

# group (continued): <Func 2> Excavation for Slab edge (ratio 1.1 적용)
forRefOutput_6 = CodeBlock(MainOutput=code_block_278)  # unwired: geoColor, 터파기형상; same code as forRefOutput

# group: Output Manager
output_47 = CodeBlock(MainOutput=forRefOutput_6) { MainOutput; RefOutput_geoColor; }  # unwired: RefOutput_geoColor
reference_output_47 = CodeBlock(ref=code_block_276, ref2=getParameterValueByName_14) { ref; ref2; }

# group: Input Manager
value_for_import_from_others_55 = CodeBlock(MainInput=code_block_265, RefInput1=reference_output_47.ref2) { MainInput; RefInput1; RefInput2; }  # unwired: RefInput2

# group: <Func 4>Disposal
code_block_279 = CodeBlock(i=value_for_import_from_others_55.RefInput1) { Math.Round(List.Flatten(i), 2); }
code_block_280 = CodeBlock { "M3"; }
count_56 = List.Count(list=code_block_279)
ofRepeatedItem_49 = List.OfRepeatedItem(item=code_block_280, amount=count_56)
code_block_281 = CodeBlock(FuncValues=code_block_279, FuncValuesUnit=ofRepeatedItem_49)  # same code as code_block_6

# group: Output Manager
reference_output_48 = CodeBlock(ref=code_block_279) { ref; }
output_48 = CodeBlock(MainOutput=code_block_281) { MainOutput; RefOutput_geoColor; }  # unwired: RefOutput_geoColor

# group: Input Manager
value_for_import_from_others_56 = CodeBlock(MainInput=code_block_265, RefInput1=reference_output_47.ref, RefInput2=reference_output_48) { MainInput; RefInput1; RefInput2; RefInput3; }  # unwired: RefInput3

# group: <Func 3> Backfill
value_for_import_from_others_57 = CodeBlock(Excavation=value_for_import_from_others_56.RefInput1) { Excavation; }
value_for_import_from_others_58 = CodeBlock(Disposal=value_for_import_from_others_56.RefInput2) { Disposal; }
code_block_282 = CodeBlock { "M3"; }

sub_6 = value_for_import_from_others_57 - value_for_import_from_others_58

# group (continued): <Func 3> Backfill
watch_26 = Watch(sub_6)
code_block_283 = CodeBlock(i=watch_26) { Math.Round(List.Flatten(i)/1000000000, 2); }
count_57 = List.Count(list=watch_26)
ofRepeatedItem_50 = List.OfRepeatedItem(item=code_block_282, amount=count_57)
# note: 터파기 물량ㅈ에서 콘크리트, 린 기둥 물량 빼기
code_block_284 = CodeBlock(FuncValues=code_block_283, FuncValuesUnit=ofRepeatedItem_50)  # same code as code_block_6

# group: Output Manager
output_49 = CodeBlock(MainOutput=code_block_284) { MainOutput; RefOutput_geoColor; }  # unwired: RefOutput_geoColor
reference_output_49 = CodeBlock { ref; }  # unwired: ref

# group: Input Manager
value_for_import_from_others_59 = CodeBlock(MainInput=code_block_265) { MainInput; RefInput1; RefInput2; }  # unwired: RefInput1, RefInput2

# group: <Func 6>Rebar Work
code_block_285 = CodeBlock { "TargetElements"; }
valueAtKey_58 = DesignScript.Builtin.Dictionary.ValueAtKey(dictionary=value_for_import_from_others_59.MainInput, key=code_block_285)
code_block_286 = CodeBlock { "Volume"; }
# note: <Func>
getParameterValueByName_15 = Element.GetParameterValueByName(element=valueAtKey_58, parameterName=code_block_286)
slab_edge_철근비 = DoubleInput(0)  # graph input
mul_5 = getParameterValueByName_15 * slab_edge_철근비
code_block_287 = CodeBlock(i=mul_5) { Math.Round(List.Flatten(i)/1, 2); }
code_block_288 = CodeBlock { "TON"; }
count_58 = List.Count(list=code_block_287)
ofRepeatedItem_51 = List.OfRepeatedItem(item=code_block_288, amount=count_58)
code_block_289 = CodeBlock(FuncValues=code_block_287, FuncValuesUnit=ofRepeatedItem_51)  # same code as code_block_6

# group: Output Manager
output_50 = CodeBlock(MainOutput=code_block_289) { MainOutput; RefOutput_geoColor; }  # unwired: RefOutput_geoColor
reference_output_50 = CodeBlock { ref; }  # unwired: ref

join_5 = List.Join(list1=output_45.MainOutput, list2=output_46.MainOutput, list4=output_47.MainOutput, list5=output_49.MainOutput, list6=output_48.MainOutput, list10=output_50.MainOutput)  # unwired: list0, list3, list7, list8, list9

# group: Visual Manager
visual_켜기_끄기_15 = BoolSelector(false)
visual_manager_15 = Python(IN[0]=output_47.RefOutput_geoColor, IN[1]=visual_켜기_끄기_15)  # CPython3; same code as visual_manager

watch_27 = Watch(output_47.MainOutput)

# group: Select Target Family Element And Connected WorkMasters
code_block_290 = CodeBlock { 4; }
select_target_family_element_and_6 = Python(IN[0]=set_up_all_element_inform_as, IN[1]=code_block_290)  # "Select Target Family Element And Connected WorkMasters"; CPython3; same code as select_target_family_element_and

code_block_291 = CodeBlock(i=select_target_family_element_and_6) { i; }

# group: Input Manager
value_for_import_from_others_60 = CodeBlock(MainInput=code_block_291) { MainInput; RefInput1; RefInput2; }  # unwired: RefInput1, RefInput2

# group: <Func 0> 파일 길이 M
code_block_292 = CodeBlock { "TargetElements"; }
# note: <Func>
valueAtKey_59 = DesignScript.Builtin.Dictionary.ValueAtKey(dictionary=value_for_import_from_others_60.MainInput, key=code_block_292)
code_block_293 = CodeBlock { "M"; }

elementType = Element.ElementType(element=valueAtKey_59)
code_block_294 = CodeBlock { "최소 내포"; "Depth"; }
getParameterValueByName_16 = Element.GetParameterValueByName(element=elementType, parameterName=code_block_294.out0)
getParameterValueByName_17 = Element.GetParameterValueByName(element=elementType, parameterName=code_block_294.out1)
code_block_295 = CodeBlock(최소내포=getParameterValueByName_16, Depth=getParameterValueByName_17) { 최소내포 + Depth; }

# group (continued): <Func 0> 파일 길이 M
code_block_296 = CodeBlock(i=code_block_295) { Math.Round(List.Flatten(i)/1000, 2); }
count_59 = List.Count(list=code_block_296)
ofRepeatedItem_52 = List.OfRepeatedItem(item=code_block_293, amount=count_59)
code_block_297 = CodeBlock(FuncValues=code_block_296, FuncValuesUnit=ofRepeatedItem_52)  # same code as code_block_6

# group: Output Manager
output_51 = CodeBlock(MainOutput=code_block_297) { MainOutput; RefOutput_geoColor; }  # unwired: RefOutput_geoColor
reference_output_51 = CodeBlock { ref; }  # unwired: ref

# group: <Func 6> Visual Manager
visual_켜기_끄기_16 = BoolSelector(false)
visual_manager_16 = Python(IN[0]=output_51.RefOutput_geoColor, IN[1]=visual_켜기_끄기_16)  # CPython3; same code as visual_manager

watch_28 = Watch(select_target_family_element_and_6)
