# Dynamo graph 05 Str Framing (220110).dyn (Dynamo 2.12.0.5650)

# group: Primary Input : Excel & Revit Elements
categories = Categories("OST_StructuralFraming")
all_elements_of_category = ElementsOfCategory(Category=categories)
string_from_web = Python()  # CPython3; unwired: IN[0]
# ---------- string_from_web.python (19 lines) ----------
# Load the Python Standard and DesignScript Libraries
import sys
import clr
clr.AddReference('ProtoGeometry')
from Autodesk.DesignScript.Geometry import *
import urllib.request

# The inputs to this node will be stored as a list in the IN variables.
dataEnteringNode = IN
inputURL = "https://raw.githubusercontent.com/HNANmal/mQ/master/Hdynlib/General/ImportExcel.py"

# Place your code below this line
req = urllib.request
data = req.urlopen(inputURL)

result = data.read().decode("utf-8")

# Assign your output to the OUT variable.
OUT = result
# ----------------------------------------
file_path = Filename(".\DMS(Data Matching Schedule)_R0(Seq.0-1).xlsx")  # graph input
sheet_name = CodeBlock { "Str Framing"; }
github_python_import_excel_by = PythonStringNode(script=string_from_web, IN[0]=file_path, IN[1]=sheet_name)  # "Github_Python@Import Excel(By OpenpyXl)"; CPython3
code_block = CodeBlock(InputElement=all_elements_of_category, InputData=github_python_import_excel_by) { _InputElement; _InputData; }

# group: GetFull WMCodeDescription PerElement
excelDataManagerNode = Python(IN[0]=code_block._InputElement, IN[1]=code_block._InputData)  # CPython3
# ---------- excelDataManagerNode.python (279 lines) ----------
# Load the Python Standard and DesignScript Libraries
import os
import sys
sys.path.append(os.getenv('LOCALAPPDATA').replace('\\','\\\\') + r'\Programs\Python\Python39\Lib\site-packages')
import clr
clr.AddReference('RevitAPI')
import Autodesk

clr.AddReference('ProtoGeometry')
from Autodesk.DesignScript.Geometry import *

clr.AddReference('RevitNodes')
import Revit
clr.ImportExtensions(Revit.Elements)

clr.ImportExtensions(Revit.GeometryConversion)
clr.ImportExtensions(Revit.GeometryReferences)

clr.AddReference('RevitServices')
import RevitServices
from RevitServices.Persistence import DocumentManager
from RevitServices.Transactions import TransactionManager

doc = DocumentManager.Instance.CurrentDBDocument

import random
import itertools
from functools import reduce
from collections import Iterable
import datetime
import openpyxl

def iterable(obj):
    return isinstance(obj, Iterable)

def findUnique(inputs):
    result = []
    for i in inputs:
        if i in result:
            pass
        else:
            result.append(i)
    return result

# The inputs to this node will be stored as a list in the IN variables.
dataEnteringNode = IN
inputElements = IN[0]
inputData = IN[1]
#inputSheetName = IN[2]

def importExcel(path, SheetNameIn):
    wb_obj = openpyxl.load_workbook(str(path), data_only=True)
    sheet_obj = wb_obj.get_sheet_by_name(str(SheetNameIn))

    m_row = sheet_obj.max_row
    m_col = sheet_obj.max_column

    listOut = []

    for i in range(1, m_row +1):
        listTemp = []
        for j in range(1, m_col + 1):
            cell_obj = sheet_obj.cell(row=i, column=j)
            listTemp.append(cell_obj.value)
            if len(listTemp) == m_col:
                listOut.append(listTemp)
    return listOut

def getUsedFamilyTypeOfModeling(elements):
    familyCode = list(map(lambda x: x.Name.split('_')[0], elements))
    unq_familyCode = findUnique(familyCode)
    return unq_familyCode
    
def createExcelDataDictionary(values):
    result = {}
    for i in range(len(values)):
        result[str(i)] = values[i]
    return result

def findTargetIndex(targets, list):
    result = []
    for target in targets:
        for i in range(len(list)):
            if target in str(list[i]):
                result.append(i)
            else:
                pass
    result.sort()
    return result
    
def GetValueAtKeys(keys, dictionary):
    result = [] 
    for i in keys:
        result.append(dictionary[str(i)])
    return result


# Place your code below this line
usedFamilyTypeOfModeling = getUsedFamilyTypeOfModeling(inputElements)
excelWholeDataSet = inputData#importExcel(inputFilePath, inputSheetName)
trExcelWholeDataSet = list(zip(*excelWholeDataSet))
excelColumnDataSet = createExcelDataDictionary(trExcelWholeDataSet)
excelRowDataSet = createExcelDataDictionary(excelWholeDataSet)
ColumnIndexOfUsedFamilyType = findTargetIndex(usedFamilyTypeOfModeling, trExcelWholeDataSet)
ColDataSetOfUsedFamilyType = GetValueAtKeys(ColumnIndexOfUsedFamilyType, excelColumnDataSet)
materialPerElementFromModeling = []
for i in inputElements:
    materialPerElementFromModeling.append(i.GetMaterials())
#list(map(lambda x: x.GetMaterials, inputElements)) "맵함수로 처리하면 리스트화 할 때 타입 변환 오류 남"

targetWMRowIndex = []
for i in ColDataSetOfUsedFamilyType:
    targetWMRowIndex.append(findTargetIndex(['000'], i))

rowDataSetOfUsedWM = []
for i in targetWMRowIndex:
    rowDataSetOfUsedWM.append(GetValueAtKeys(i, excelRowDataSet))

workGroup = []
for i in rowDataSetOfUsedWM:
    tmp = []
    for j in i:
        tmp.append(j[0])
    workGroup.append(tmp)
    
workMaster = []
for i in range(len(ColDataSetOfUsedFamilyType)):
    tmp=[]
    for k in targetWMRowIndex[i]:
        tmp.append(ColDataSetOfUsedFamilyType[i][k])
    workMaster.append(tmp)

matchedWM = []
for i in range(len(workGroup)):
    tmp = []
    for j in range(len(workGroup[i])):
        fullWM = workGroup[i][j] +"-"+ workMaster[i][j]
        tmp.append(fullWM)
    matchedWM.append(tmp)

matchedWorkGruopAndMasterCode = []
for i in matchedWM:
    if len(i) > 0:
        matchedWorkGruopAndMasterCode.append(i)
    else:
        pass

matchedWMDescription = []
for i in rowDataSetOfUsedWM:
    tmp=[]
    for j in i:
        tmp.append(j[1] +" "+ j[2] +" "+ j[3] +" "+ "("+ j[4] +")")
    if len(tmp) > 0:
        matchedWMDescription.append(tmp)
    else:
        pass

matchedWMUnit = []
for i in rowDataSetOfUsedWM:
    tmp=[]
    for j in i:
        tmp.append(j[4])
    if len(tmp) > 0:
        matchedWMUnit.append(tmp)
    else:
        pass

matchedWorkGruopAndMasterCode_flat = list(itertools.chain(*matchedWorkGruopAndMasterCode))
matchedWMDescription_flat = list(itertools.chain(*matchedWMDescription))

dic_WMandDescription_Excel = {}
for i in range(len(matchedWorkGruopAndMasterCode_flat)):
    dic_WMandDescription_Excel[matchedWorkGruopAndMasterCode_flat[i]] = matchedWMDescription_flat[i]

usedFamilyTypeInExcelOrder = list(map(lambda x: x[3], ColDataSetOfUsedFamilyType))
usedFamilyCodeInExcelOrder = findUnique(list(map(lambda x: x.split('_')[0], usedFamilyTypeInExcelOrder)))

dic_FamilyCodeandWM = {}
for i in range(len(usedFamilyCodeInExcelOrder)):
    dic_FamilyCodeandWM[usedFamilyCodeInExcelOrder[i]] = matchedWorkGruopAndMasterCode[i]

workMasterCodePerElement = []
familyCodePerElem = list(map(lambda x: x.Name.split('_')[0], inputElements))
for i in familyCodePerElem:
    workMasterCodePerElement.append(dic_FamilyCodeandWM[i])

materialNamePerElem = []
for i in materialPerElementFromModeling:
    tmp = []
    for j in i:
        tmp.append(j.Name)
    materialNamePerElem.append(tmp)

WMPerElementFromModeling = []
for i in materialNamePerElem:
    tmp = []
    for j in i:
        tmp.append(j.split('_')[0])
    WMPerElementFromModeling.append(tmp)

specPerElementFromModeling = []
for i in materialNamePerElem:
    tmp = []
    for j in i:
        a = j.split('_')
        del a[0]
        b = " ".join(a)
        tmp.append(b)
    specPerElementFromModeling.append(tmp)

WMPerElementFromModeling_flat = list(itertools.chain(*WMPerElementFromModeling))
specPerElementFromModeling_flat = list(itertools.chain(*specPerElementFromModeling))

dic_WMandDescription_Model = {}
for i in range(len(WMPerElementFromModeling_flat)):
    dic_WMandDescription_Model[WMPerElementFromModeling_flat[i]] = specPerElementFromModeling_flat[i]

def findAllKeys(dict):
    result = []
    for key in dict.keys():
        result.append(key)
    return result

def findAllValues(dict):
    result = []
    for key in dict.keys():
        result.append(dict[key])
    return result

keys_WMandDescription_Model = findAllKeys(dic_WMandDescription_Model)
keys_WMandDescription_Excel = findAllKeys(dic_WMandDescription_Excel)

keys_WMandDescription_Both = list(set(keys_WMandDescription_Model + keys_WMandDescription_Excel))
values_WMandDescription_Both = []
for i in keys_WMandDescription_Both:
    if i in keys_WMandDescription_Model:
        values_WMandDescription_Both.append(dic_WMandDescription_Model[i])
    else:
        values_WMandDescription_Both.append(dic_WMandDescription_Excel[i])

dic_WMandDescription_Both = {}
for i in range(len(keys_WMandDescription_Both)):
    dic_WMandDescription_Both[keys_WMandDescription_Both[i]] = values_WMandDescription_Both[i]

workMasterCodePerElementFromBoth = []
for i in range(len(workMasterCodePerElement)):
    #tmp = []
    a = WMPerElementFromModeling[i] + workMasterCodePerElement[i]
    b = findUnique(a)
    workMasterCodePerElementFromBoth.append(b)

specPerElement = []
for i in workMasterCodePerElementFromBoth:
    tmp = []
    for j in i:
        tmp.append(dic_WMandDescription_Both[j])
    specPerElement.append(tmp)

fullWMCodeDescriptionPerElement = []
for i in range(len(workMasterCodePerElementFromBoth)):
    tmp = []
    for j in range(len(workMasterCodePerElementFromBoth[i])):
        a = workMasterCodePerElementFromBoth[i][j] +": "+ specPerElement[i][j]
        tmp.append(a)
    fullWMCodeDescriptionPerElement.append(tmp)

fullWMinfo = {
"AllElement": inputElements,
"WorkMasterCodePerFamilyType": dic_FamilyCodeandWM,
"WorkMasterCodePerElementBoth": workMasterCodePerElementFromBoth,
"FullWMCodeDescriptionPerElement": fullWMCodeDescriptionPerElement
}



result = fullWMinfo

# Assign your output to the OUT variable.
OUT = result
# ----------------------------------------

# group: Organize AllElementInform AsDictionary
set_up_all_element_inform_as = Python(IN[0]=excelDataManagerNode)  # "Set Up All Element Inform as Dictionary"; CPython3
# ---------- set_up_all_element_inform_as.python (119 lines) ----------
# Load the Python Standard and DesignScript Libraries
import os
import sys
sys.path.append(os.getenv('LOCALAPPDATA').replace('\\','\\\\') + r'\Programs\Python\Python39\Lib\site-packages')
import clr
clr.AddReference('RevitAPI')
import Autodesk

clr.AddReference('ProtoGeometry')
from Autodesk.DesignScript.Geometry import *

clr.AddReference('RevitNodes')
import Revit
clr.ImportExtensions(Revit.Elements)

clr.ImportExtensions(Revit.GeometryConversion)
clr.ImportExtensions(Revit.GeometryReferences)

clr.AddReference('RevitServices')
import RevitServices
from RevitServices.Persistence import DocumentManager
from RevitServices.Transactions import TransactionManager

doc = DocumentManager.Instance.CurrentDBDocument

import random
import itertools
from functools import reduce
from collections import Iterable
import datetime
import openpyxl

def iterable(obj):
    return isinstance(obj, Iterable)

def findUnique(inputs):
    result = []
    for i in inputs:
        if i in result:
            pass
        else:
            result.append(i)
    return result

# The inputs to this node will be stored as a list in the IN variables.
dataEnteringNode = IN
inputDict = IN[0]


def importExcel(path, SheetNameIn):
    wb_obj = openpyxl.load_workbook(str(path), data_only=True)
    sheet_obj = wb_obj.get_sheet_by_name(str(SheetNameIn))

    m_row = sheet_obj.max_row
    m_col = sheet_obj.max_column

    listOut = []

    for i in range(1, m_row +1):
        listTemp = []
        for j in range(1, m_col + 1):
            cell_obj = sheet_obj.cell(row=i, column=j)
            listTemp.append(cell_obj.value)
            if len(listTemp) == m_col:
                listOut.append(listTemp)
    return listOut

def getUsedFamilyTypeOfModeling(elements):
    familyCode = list(map(lambda x: x.Name.split('_')[0], elements))
    unq_familyCode = findUnique(familyCode)
    return unq_familyCode
    
def createExcelDataDictionary(values):
    result = {}
    for i in range(len(values)):
        result[str(i)] = values[i]
    return result

def findTargetIndex(targets, list):
    result = []
    for target in targets:
        for i in range(len(list)):
            if target in str(list[i]):
                result.append(i)
            else:
                pass
    result.sort()
    return result
    
def GetValueAtKeys(keys, dictionary):
    result = [] 
    for i in keys:
        result.append(dictionary[str(i)])
    return result


# Place your code below this line
element = inputDict["AllElement"]
elementType = []
for i in element:
    elementType.append(i.Name)
familyCode = []
for i in elementType:
    familyCode.append(i.split("_")[0])
fullWMCodeDescriptionPerElement = inputDict["FullWMCodeDescriptionPerElement"]

resultDict = {
"Element": element,
"ElementType": elementType,
"FamilyCode": familyCode,
"FullWMCodeDescriptionPerElement": fullWMCodeDescriptionPerElement
}



result = resultDict

# Assign your output to the OUT variable.
OUT = result
# ----------------------------------------

# group: Select Target Family Element And Connected WorkMasters
code_block_2 = CodeBlock { 0; }
select_target_family_element_and = Python(IN[0]=set_up_all_element_inform_as, IN[1]=code_block_2)  # "Select Target Family Element And Connected WorkMasters"; CPython3
# ---------- select_target_family_element_and.python (138 lines) ----------
# Load the Python Standard and DesignScript Libraries
import os
import sys
sys.path.append(os.getenv('LOCALAPPDATA').replace('\\','\\\\') + r'\Programs\Python\Python39\Lib\site-packages')
import clr
clr.AddReference('RevitAPI')
import Autodesk

clr.AddReference('ProtoGeometry')
from Autodesk.DesignScript.Geometry import *

clr.AddReference('RevitNodes')
import Revit
clr.ImportExtensions(Revit.Elements)

clr.ImportExtensions(Revit.GeometryConversion)
clr.ImportExtensions(Revit.GeometryReferences)

clr.AddReference('RevitServices')
import RevitServices
from RevitServices.Persistence import DocumentManager
from RevitServices.Transactions import TransactionManager

doc = DocumentManager.Instance.CurrentDBDocument

import random
import itertools
from functools import reduce
from collections import Iterable
import datetime
import openpyxl

def iterable(obj):
    return isinstance(obj, Iterable)

def findUnique(inputs):
    result = []
    for i in inputs:
        if i in result:
            pass
        else:
            result.append(i)
    return result

# The inputs to this node will be stored as a list in the IN variables.
dataEnteringNode = IN
inputDict = IN[0]
inputIndex = IN[1]


def importExcel(path, SheetNameIn):
    wb_obj = openpyxl.load_workbook(str(path), data_only=True)
    sheet_obj = wb_obj.get_sheet_by_name(str(SheetNameIn))

    m_row = sheet_obj.max_row
    m_col = sheet_obj.max_column

    listOut = []

    for i in range(1, m_row +1):
        listTemp = []
        for j in range(1, m_col + 1):
            cell_obj = sheet_obj.cell(row=i, column=j)
            listTemp.append(cell_obj.value)
            if len(listTemp) == m_col:
                listOut.append(listTemp)
    return listOut

def getUsedFamilyTypeOfModeling(elements):
    familyCode = list(map(lambda x: x.Name.split('_')[0], elements))
    unq_familyCode = findUnique(familyCode)
    return unq_familyCode
    
def createExcelDataDictionary(values):
    result = {}
    for i in range(len(values)):
        result[str(i)] = values[i]
    return result

def findTargetIndex(targets, list):
    result = []
    for target in targets:
        for i in range(len(list)):
            if target in str(list[i]):
                result.append(i)
            else:
                pass
    result.sort()
    return result
    
def GetValueAtKeys(keys, dictionary):
    result = [] 
    for i in keys:
        result.append(dictionary[str(i)])
    return result


# Place your code below this line
fullWMCodeDescriptionPerElement = inputDict["FullWMCodeDescriptionPerElement"]
element = inputDict["Element"]
familyCode = inputDict["FamilyCode"]
familyCode_unique = findUnique(familyCode)
targetFamilyCode = familyCode_unique[inputIndex]
targetIndex = []
for i in range(len(familyCode)):
    if targetFamilyCode in familyCode[i]:
        targetIndex.append(i)
    else:
        pass

targetElements = []
for i in targetIndex:
    targetElements.append(element[i])

targetFamilyCode = []
for i in targetIndex:
    targetFamilyCode.append(element[i].Name)

WMforTargetElements = []
for i in targetIndex:
    WMforTargetElements.append(fullWMCodeDescriptionPerElement[i])

WMforTargetElements_flat = list(itertools.chain(*WMforTargetElements))
targetWMunique = findUnique(WMforTargetElements_flat)

resultDict = {
"TargetElements": targetElements,
"TargetFamilyCode": targetFamilyCode,
"WMforTargetElements": WMforTargetElements,
"TargetWMunique": targetWMunique
}



result = resultDict

# Assign your output to the OUT variable.
OUT = result
# ----------------------------------------

watch = Watch(select_target_family_element_and)
code_block_3 = CodeBlock(i=select_target_family_element_and) { i; }

# group: Input Manager
value_for_import_from_others = CodeBlock(MainInput=code_block_3) { MainInput; RefInput1; RefInput2; }  # unwired: RefInput1, RefInput2

# group: <Func 1>Substructure Structural Concrete (M3)
code_block_4 = CodeBlock { "TargetElements"; }
# note: <Func>
valueAtKey = DesignScript.Builtin.Dictionary.ValueAtKey(dictionary=value_for_import_from_others.MainInput, key=code_block_4)
code_block_5 = CodeBlock { "M3"; }

geometry = Element.Geometry(element=valueAtKey)

# group (continued): <Func 1>Substructure Structural Concrete (M3)
volume = Solid.Volume(solid=geometry)
code_block_6 = CodeBlock(i=volume) { Math.Round(List.Flatten(i)/1000000000, 2); }
count = List.Count(list=code_block_6)
ofRepeatedItem = List.OfRepeatedItem(item=code_block_5, amount=count)
code_block_7 = CodeBlock(FuncValues=code_block_6, FuncValuesUnit=ofRepeatedItem)
# ---------- code_block_7.designscript (4 lines) ----------
{
"FuncValues": _FuncValues,
"FuncValuesUnit": _FuncValuesUnit
};
# ----------------------------------------

# group: Output Manager
output = CodeBlock(MainOutput=code_block_7) { MainOutput; RefOutput_geoColor; }  # unwired: RefOutput_geoColor
reference_output = CodeBlock { ref; }  # unwired: ref

# group: Visual Manager
visual_켜기_끄기 = BoolSelector(false)
visual_manager = Python(IN[0]=output.RefOutput_geoColor, IN[1]=visual_켜기_끄기)  # CPython3
# ---------- visual_manager.python (18 lines) ----------
# Load the Python Standard and DesignScript Libraries
import sys
import clr
clr.AddReference('ProtoGeometry')
from Autodesk.DesignScript.Geometry import *

# The inputs to this node will be stored as a list in the IN variables.
dataEnteringNode = IN
geoColors = IN[0]
blnForVisual = IN[1]

# Place your code below this line
if blnForVisual == True:
    result = geoColors
else:
    result = 0
# Assign your output to the OUT variable.
OUT = result
# ----------------------------------------

# group: Select Target Family Element And Connected WorkMasters
code_block_8 = CodeBlock { 1; }
select_target_family_element_and_2 = Python(IN[0]=set_up_all_element_inform_as, IN[1]=code_block_8)  # "Select Target Family Element And Connected WorkMasters"; CPython3; same code as select_target_family_element_and

watch_2 = Watch(select_target_family_element_and_2)

# group: Select Target Family Element And Connected WorkMasters
code_block_9 = CodeBlock { 2; }
select_target_family_element_and_3 = Python(IN[0]=set_up_all_element_inform_as, IN[1]=code_block_9)  # "Select Target Family Element And Connected WorkMasters"; CPython3; same code as select_target_family_element_and

watch_3 = Watch(select_target_family_element_and_3)

# group: Input Manager
value_for_import_from_others_2 = CodeBlock(MainInput=code_block_3) { MainInput; RefInput1; RefInput2; }  # unwired: RefInput1, RefInput2

# group: <Func 2>Substructure Form Work (M2)
code_block_10 = CodeBlock { "TargetElements"; }
valueAtKey_2 = DesignScript.Builtin.Dictionary.ValueAtKey(dictionary=value_for_import_from_others_2.MainInput, key=code_block_10)
# note: <Func>
extractSideFacesOfElement = Custom[ExtractSideFacesOfElement](Element=valueAtKey_2)  # ExtractSideFacesOfElement
getLocation = Element.GetLocation(element=valueAtKey_2)
direction = Line.Direction(line=getLocation)
code_block_11 = CodeBlock { 0.5; }
normalAtParameter = Surface.NormalAtParameter(surface=extractSideFacesOfElement.Surface, u=code_block_11, v=code_block_11)
isParallel = Vector.IsParallel(vector=direction, otherVector=normalAtParameter)
filterByBoolMask = List.FilterByBoolMask(list=extractSideFacesOfElement.Surface, mask=isParallel)
area = Surface.Area(surface=filterByBoolMask.out)
sum = Math.Sum(values=area)
code_block_12 = CodeBlock(i=sum) { Math.Round(List.Flatten(i)/1000000, 2); }
code_block_13 = CodeBlock { "M2"; }
count_2 = List.Count(list=code_block_12)
ofRepeatedItem_2 = List.OfRepeatedItem(item=code_block_13, amount=count_2)
code_block_14 = CodeBlock(FuncValues=code_block_12, FuncValuesUnit=ofRepeatedItem_2)  # same code as code_block_7

# group: Output Manager
reference_output_2 = CodeBlock { ref; }  # unwired: ref
output_2 = CodeBlock(MainOutput=code_block_14, RefOutput_geoColor=filterByBoolMask.out) { MainOutput; RefOutput_geoColor; }

# group: Visual Manager
visual_켜기_끄기_2 = BoolSelector(true)
visual_manager_2 = Python(IN[0]=output_2.RefOutput_geoColor, IN[1]=visual_켜기_끄기_2)  # CPython3; same code as visual_manager

# group: Input Manager
value_for_import_from_others_3 = CodeBlock(MainInput=code_block_3) { MainInput; RefInput1; RefInput2; }  # unwired: RefInput1, RefInput2

# group: <Func 3>Substructure Rebar Work
code_block_15 = CodeBlock { "TargetElements"; }
valueAtKey_3 = DesignScript.Builtin.Dictionary.ValueAtKey(dictionary=value_for_import_from_others_3.MainInput, key=code_block_15)
code_block_16 = CodeBlock { "Volume"; }
# note: <Func>
getParameterValueByName = Element.GetParameterValueByName(element=valueAtKey_3, parameterName=code_block_16)
sog_철근비 = DoubleInput(0)  # graph input
mul = getParameterValueByName * sog_철근비
code_block_17 = CodeBlock(i=mul) { Math.Round(List.Flatten(i)/1, 2); }
code_block_18 = CodeBlock { "TON"; }
count_3 = List.Count(list=code_block_17)
ofRepeatedItem_3 = List.OfRepeatedItem(item=code_block_18, amount=count_3)
code_block_19 = CodeBlock(FuncValues=code_block_17, FuncValuesUnit=ofRepeatedItem_3)  # same code as code_block_7

# group: Output Manager
reference_output_3 = CodeBlock { ref; }  # unwired: ref
output_3 = CodeBlock(MainOutput=code_block_19) { MainOutput; RefOutput_geoColor; }  # unwired: RefOutput_geoColor

# group: Input Manager
value_for_import_from_others_4 = CodeBlock(MainInput=code_block_3) { MainInput; RefInput1; RefInput2; }  # unwired: RefInput1, RefInput2

# group: <Func 4>Concrete Protective Coating (U/G)
code_block_20 = CodeBlock { "TargetElements"; }
valueAtKey_4 = DesignScript.Builtin.Dictionary.ValueAtKey(dictionary=value_for_import_from_others_4.MainInput, key=code_block_20)
# note: <Func>
extractSideFacesOfElement_2 = Custom[ExtractSideFacesOfElement](Element=valueAtKey_4)
getLocation_2 = Element.GetLocation(element=valueAtKey_4)
direction_2 = Line.Direction(line=getLocation_2)
code_block_21 = CodeBlock { 0.5; }
normalAtParameter_2 = Surface.NormalAtParameter(surface=extractSideFacesOfElement_2.Surface, u=code_block_21, v=code_block_21)
isParallel_2 = Vector.IsParallel(vector=direction_2, otherVector=normalAtParameter_2)
filterByBoolMask_2 = List.FilterByBoolMask(list=extractSideFacesOfElement_2.Surface, mask=isParallel_2)
area_2 = Surface.Area(surface=filterByBoolMask_2.out)
sum_2 = Math.Sum(values=area_2)
code_block_22 = CodeBlock(i=sum_2) { Math.Round(List.Flatten(i)/1000000, 2); }
code_block_23 = CodeBlock { "M2"; }
count_4 = List.Count(list=code_block_22)
ofRepeatedItem_4 = List.OfRepeatedItem(item=code_block_23, amount=count_4)
code_block_24 = CodeBlock(FuncValues=code_block_22, FuncValuesUnit=ofRepeatedItem_4)  # same code as code_block_7

# group: Output Manager
reference_output_4 = CodeBlock { ref; }  # unwired: ref
output_4 = CodeBlock(MainOutput=code_block_24, RefOutput_geoColor=filterByBoolMask_2.out) { MainOutput; RefOutput_geoColor; }

# group: Visual Manager
visual_켜기_끄기_3 = BoolSelector(false)
visual_manager_3 = Python(IN[0]=output_4.RefOutput_geoColor, IN[1]=visual_켜기_끄기_3)  # CPython3; same code as visual_manager

code_block_25 = CodeBlock(i=select_target_family_element_and_2) { i; }
code_block_26 = CodeBlock(i=code_block_25) { i; }

# group: Input Manager
value_for_import_from_others_5 = CodeBlock(MainInput=code_block_26) { MainInput; RefInput1; RefInput2; }  # unwired: RefInput1, RefInput2

# group: <Func 3>Superstructure Rebar Work
code_block_27 = CodeBlock { "TargetElements"; }
valueAtKey_5 = DesignScript.Builtin.Dictionary.ValueAtKey(dictionary=value_for_import_from_others_5.MainInput, key=code_block_27)
code_block_28 = CodeBlock { "Volume"; }
# note: <Func>
getParameterValueByName_2 = Element.GetParameterValueByName(element=valueAtKey_5, parameterName=code_block_28)
sog_철근비_2 = DoubleInput(0)  # graph input
mul_2 = getParameterValueByName_2 * sog_철근비_2
code_block_29 = CodeBlock(i=mul_2) { Math.Round(List.Flatten(i)/1, 2); }
code_block_30 = CodeBlock { "TON"; }
count_5 = List.Count(list=code_block_29)
ofRepeatedItem_5 = List.OfRepeatedItem(item=code_block_30, amount=count_5)
code_block_31 = CodeBlock(FuncValues=code_block_29, FuncValuesUnit=ofRepeatedItem_5)  # same code as code_block_7

# group: Output Manager
reference_output_5 = CodeBlock { ref; }  # unwired: ref
output_5 = CodeBlock(MainOutput=code_block_31) { MainOutput; RefOutput_geoColor; }  # unwired: RefOutput_geoColor

# group: Input Manager
value_for_import_from_others_6 = CodeBlock(MainInput=code_block_26) { MainInput; RefInput1; RefInput2; }  # unwired: RefInput1, RefInput2

# group: <Func 2>Superstructure Form Work
# note: 하단 폼 추가
code_block_32 = CodeBlock { "TargetElements"; }
valueAtKey_6 = DesignScript.Builtin.Dictionary.ValueAtKey(dictionary=value_for_import_from_others_6.MainInput, key=code_block_32)
# note: <Func>
extractSideFacesOfElement_3 = Custom[ExtractSideFacesOfElement](Element=valueAtKey_6)
getLocation_3 = Element.GetLocation(element=valueAtKey_6)
direction_3 = Line.Direction(line=getLocation_3)
code_block_33 = CodeBlock { 0.5; }
normalAtParameter_3 = Surface.NormalAtParameter(surface=extractSideFacesOfElement_3.Surface, u=code_block_33, v=code_block_33)
isParallel_3 = Vector.IsParallel(vector=direction_3, otherVector=normalAtParameter_3)
filterByBoolMask_3 = List.FilterByBoolMask(list=extractSideFacesOfElement_3.Surface, mask=isParallel_3)
area_3 = Surface.Area(surface=filterByBoolMask_3.out)
sum_3 = Math.Sum(values=area_3)
code_block_34 = CodeBlock(i=sum_3) { Math.Round(List.Flatten(i)/1000000, 2); }
code_block_35 = CodeBlock { "M2"; }
count_6 = List.Count(list=code_block_34)
ofRepeatedItem_6 = List.OfRepeatedItem(item=code_block_35, amount=count_6)
code_block_36 = CodeBlock(FuncValues=code_block_34, FuncValuesUnit=ofRepeatedItem_6)  # same code as code_block_7

# group: Output Manager
output_6 = CodeBlock(MainOutput=code_block_36, RefOutput_geoColor=filterByBoolMask_3.out) { MainOutput; RefOutput_geoColor; }
reference_output_6 = CodeBlock { ref; }  # unwired: ref

# group: Visual Manager
visual_켜기_끄기_4 = BoolSelector(false)
visual_manager_4 = Python(IN[0]=output_6.RefOutput_geoColor, IN[1]=visual_켜기_끄기_4)  # CPython3; same code as visual_manager

# group: Input Manager
value_for_import_from_others_7 = CodeBlock(MainInput=code_block_26) { MainInput; RefInput1; RefInput2; }  # unwired: RefInput1, RefInput2

# group: <Func 1>Superstructure Concrete (M3)
code_block_37 = CodeBlock { "TargetElements"; }
# note: <Func>
valueAtKey_7 = DesignScript.Builtin.Dictionary.ValueAtKey(dictionary=value_for_import_from_others_7.MainInput, key=code_block_37)
code_block_38 = CodeBlock { "M3"; }

geometry_2 = Element.Geometry(element=valueAtKey_7)

# group (continued): <Func 1>Superstructure Concrete (M3)
volume_2 = Solid.Volume(solid=geometry_2)
code_block_39 = CodeBlock(i=volume_2) { Math.Round(List.Flatten(i)/1000000000, 2); }
count_7 = List.Count(list=code_block_39)
ofRepeatedItem_7 = List.OfRepeatedItem(item=code_block_38, amount=count_7)
code_block_40 = CodeBlock(FuncValues=code_block_39, FuncValuesUnit=ofRepeatedItem_7)  # same code as code_block_7

# group: Output Manager
output_7 = CodeBlock(MainOutput=code_block_40) { MainOutput; RefOutput_geoColor; }  # unwired: RefOutput_geoColor
reference_output_7 = CodeBlock { ref; }  # unwired: ref

# group: Visual Manager
visual_켜기_끄기_5 = BoolSelector(false)
visual_manager_5 = Python(IN[0]=output_7.RefOutput_geoColor, IN[1]=visual_켜기_끄기_5)  # CPython3; same code as visual_manager

code_block_41 = CodeBlock(i=select_target_family_element_and_3) { i; }
code_block_42 = CodeBlock(i=code_block_41) { i; }

# group: Input Manager
value_for_import_from_others_8 = CodeBlock(MainInput=code_block_42) { MainInput; RefInput1; RefInput2; }  # unwired: RefInput1, RefInput2

# group: <Func 1>Superstructure Structural Concrete (M3)
code_block_43 = CodeBlock { "TargetElements"; }
# note: <Func>
valueAtKey_8 = DesignScript.Builtin.Dictionary.ValueAtKey(dictionary=value_for_import_from_others_8.MainInput, key=code_block_43)
code_block_44 = CodeBlock { "M3"; }

geometry_3 = Element.Geometry(element=valueAtKey_8)

# group: Input Manager
value_for_import_from_others_9 = CodeBlock(MainInput=code_block_42) { MainInput; RefInput1; RefInput2; }  # unwired: RefInput1, RefInput2

# group: <Func 3>Superstructure Rebar Work
code_block_45 = CodeBlock { "TargetElements"; }
valueAtKey_9 = DesignScript.Builtin.Dictionary.ValueAtKey(dictionary=value_for_import_from_others_9.MainInput, key=code_block_45)
code_block_46 = CodeBlock { "Volume"; }
# note: <Func>
getParameterValueByName_3 = Element.GetParameterValueByName(element=valueAtKey_9, parameterName=code_block_46)
sog_철근비_3 = DoubleInput(0)  # graph input
mul_3 = getParameterValueByName_3 * sog_철근비_3
code_block_47 = CodeBlock(i=mul_3) { Math.Round(List.Flatten(i)/1, 2); }
code_block_48 = CodeBlock { "TON"; }
count_8 = List.Count(list=code_block_47)
ofRepeatedItem_8 = List.OfRepeatedItem(item=code_block_48, amount=count_8)
code_block_49 = CodeBlock(FuncValues=code_block_47, FuncValuesUnit=ofRepeatedItem_8)  # same code as code_block_7

# group: Output Manager
reference_output_8 = CodeBlock { ref; }  # unwired: ref
output_8 = CodeBlock(MainOutput=code_block_49) { MainOutput; RefOutput_geoColor; }  # unwired: RefOutput_geoColor

# group: Input Manager
value_for_import_from_others_10 = CodeBlock(MainInput=code_block_42) { MainInput; RefInput1; RefInput2; }  # unwired: RefInput1, RefInput2

# group: <Func 2>Superstructure Form Work (M2)
# note: 하단 폼 추가
code_block_50 = CodeBlock { "TargetElements"; }
valueAtKey_10 = DesignScript.Builtin.Dictionary.ValueAtKey(dictionary=value_for_import_from_others_10.MainInput, key=code_block_50)
# note: <Func>
extractSideFacesOfElement_4 = Custom[ExtractSideFacesOfElement](Element=valueAtKey_10)
getLocation_4 = Element.GetLocation(element=valueAtKey_10)
direction_4 = Line.Direction(line=getLocation_4)
code_block_51 = CodeBlock { 0.5; }
normalAtParameter_4 = Surface.NormalAtParameter(surface=extractSideFacesOfElement_4.Surface, u=code_block_51, v=code_block_51)
isParallel_4 = Vector.IsParallel(vector=direction_4, otherVector=normalAtParameter_4)
filterByBoolMask_4 = List.FilterByBoolMask(list=extractSideFacesOfElement_4.Surface, mask=isParallel_4)
area_4 = Surface.Area(surface=filterByBoolMask_4.out)
sum_4 = Math.Sum(values=area_4)
code_block_52 = CodeBlock(i=sum_4) { Math.Round(List.Flatten(i)/1000000, 2); }
code_block_53 = CodeBlock { "M2"; }
count_9 = List.Count(list=code_block_52)
ofRepeatedItem_9 = List.OfRepeatedItem(item=code_block_53, amount=count_9)
code_block_54 = CodeBlock(FuncValues=code_block_52, FuncValuesUnit=ofRepeatedItem_9)  # same code as code_block_7

# group: Output Manager
reference_output_9 = CodeBlock { ref; }  # unwired: ref
output_9 = CodeBlock(MainOutput=code_block_54, RefOutput_geoColor=filterByBoolMask_4.out) { MainOutput; RefOutput_geoColor; }

# group: Visual Manager
visual_켜기_끄기_6 = BoolSelector(false)
visual_manager_6 = Python(IN[0]=output_9.RefOutput_geoColor, IN[1]=visual_켜기_끄기_6)  # CPython3; same code as visual_manager

# group (continued): <Func 1>Superstructure Structural Concrete (M3)
volume_3 = Solid.Volume(solid=geometry_3)
code_block_55 = CodeBlock(i=volume_3) { Math.Round(List.Flatten(i)/1000000000, 2); }
count_10 = List.Count(list=code_block_55)
ofRepeatedItem_10 = List.OfRepeatedItem(item=code_block_44, amount=count_10)
code_block_56 = CodeBlock(FuncValues=code_block_55, FuncValuesUnit=ofRepeatedItem_10)  # same code as code_block_7

# group: Output Manager
reference_output_10 = CodeBlock(ref=geometry_3) { ref; }
output_10 = CodeBlock(MainOutput=code_block_56) { MainOutput; RefOutput_geoColor; }  # unwired: RefOutput_geoColor

# group: Visual Manager
visual_켜기_끄기_7 = BoolSelector(false)
visual_manager_7 = Python(IN[0]=output_10.RefOutput_geoColor, IN[1]=visual_켜기_끄기_7)  # CPython3; same code as visual_manager

# group: Select Target Family Element And Connected WorkMasters
code_block_57 = CodeBlock { 3; }
select_target_family_element_and_4 = Python(IN[0]=set_up_all_element_inform_as, IN[1]=code_block_57)  # "Select Target Family Element And Connected WorkMasters"; CPython3; same code as select_target_family_element_and

watch_4 = Watch(select_target_family_element_and_4)

# group: Output Manager
output_11 = CodeBlock { MainOutput; RefOutput_geoColor; }  # unwired: MainOutput, RefOutput_geoColor
reference_output_11 = CodeBlock { ref; }  # unwired: ref

# group: Visual Manager
visual_켜기_끄기_8 = BoolSelector(false)
visual_manager_8 = Python(IN[0]=output_11.RefOutput_geoColor, IN[1]=visual_켜기_끄기_8)  # CPython3; same code as visual_manager

# group: Output Manager
output_12 = CodeBlock { MainOutput; RefOutput_geoColor; }  # unwired: MainOutput, RefOutput_geoColor
reference_output_12 = CodeBlock { ref; }  # unwired: ref

# group: Visual Manager
visual_켜기_끄기_9 = BoolSelector(false)
visual_manager_9 = Python(IN[0]=output_12.RefOutput_geoColor, IN[1]=visual_켜기_끄기_9)  # CPython3; same code as visual_manager

# group: Output Manager
output_13 = CodeBlock { MainOutput; RefOutput_geoColor; }  # unwired: MainOutput, RefOutput_geoColor
reference_output_13 = CodeBlock { ref; }  # unwired: ref

# group: Visual Manager
visual_켜기_끄기_10 = BoolSelector(false)
visual_manager_10 = Python(IN[0]=output_13.RefOutput_geoColor, IN[1]=visual_켜기_끄기_10)  # CPython3; same code as visual_manager

# group: Output Manager
output_14 = CodeBlock { MainOutput; RefOutput_geoColor; }  # unwired: MainOutput, RefOutput_geoColor
reference_output_14 = CodeBlock { ref; }  # unwired: ref

# group: Visual Manager
visual_켜기_끄기_11 = BoolSelector(false)
visual_manager_11 = Python(IN[0]=output_14.RefOutput_geoColor, IN[1]=visual_켜기_끄기_11)  # CPython3; same code as visual_manager

code_block_58 = CodeBlock(i=select_target_family_element_and_4) { i; }
code_block_59 = CodeBlock(i=code_block_58) { i; }

# group: Input Manager
value_for_import_from_others_11 = CodeBlock(MainInput=code_block_59) { MainInput; RefInput1; RefInput2; }  # unwired: RefInput1, RefInput2

# group: <Func 1> Steel Structure Weight
code_block_60 = CodeBlock { "TargetElements"; }
# note: <Func>
valueAtKey_11 = DesignScript.Builtin.Dictionary.ValueAtKey(dictionary=value_for_import_from_others_11.MainInput, key=code_block_60)

code_block_61 = CodeBlock { "Length"; "Mass per Unit Length"; "Surface Area"; }
getParameterValueByName_4 = Element.GetParameterValueByName(element=valueAtKey_11, parameterName=code_block_61.out0)
code_block_62 = CodeBlock(a=getParameterValueByName_4) { a/1000; }
elementType = Element.ElementType(element=valueAtKey_11)
getParameterValueByName_5 = Element.GetParameterValueByName(element=elementType, parameterName=code_block_61.out1)
mul_4 = code_block_62 * getParameterValueByName_5
code_block_63 = CodeBlock(a=mul_4) { a/1000; }

# group: Input Manager
value_for_import_from_others_12 = CodeBlock(MainInput=code_block_59, RefInput1=code_block_63) { MainInput; RefInput1; RefInput2; }  # unwired: RefInput2

# group: Output Manager
reference_output_15 = CodeBlock(ref=value_for_import_from_others_12.RefInput1) { ref; }
output_15 = CodeBlock { MainOutput; RefOutput_geoColor; }  # unwired: MainOutput, RefOutput_geoColor

# group: Input Manager
value_for_import_from_others_13 = CodeBlock(MainInput=code_block_59, RefInput1=reference_output_15) { MainInput; RefInput1; RefInput2; }  # unwired: RefInput2

# group: <Func 4> Steel Structure Strength Bolt&Nuts
code_block_64 = CodeBlock { "TargetElements"; }
# note: <Func>
valueAtKey_12 = DesignScript.Builtin.Dictionary.ValueAtKey(dictionary=value_for_import_from_others_13.MainInput, key=code_block_64)

# group: Output Manager
output_16 = CodeBlock { MainOutput; RefOutput_geoColor; }  # unwired: MainOutput, RefOutput_geoColor
reference_output_16 = CodeBlock { ref; }  # unwired: ref

# group: Visual Manager
visual_켜기_끄기_12 = BoolSelector(false)
visual_manager_12 = Python(IN[0]=output_16.RefOutput_geoColor, IN[1]=visual_켜기_끄기_12)  # CPython3; same code as visual_manager

# group: Visual Manager
visual_켜기_끄기_13 = BoolSelector(false)
visual_manager_13 = Python(IN[0]=output_15.RefOutput_geoColor, IN[1]=visual_켜기_끄기_13)  # CPython3; same code as visual_manager

# group: Output Manager
output_17 = CodeBlock { MainOutput; RefOutput_geoColor; }  # unwired: MainOutput, RefOutput_geoColor
reference_output_17 = CodeBlock { ref; }  # unwired: ref

# group: Visual Manager
visual_켜기_끄기_14 = BoolSelector(false)
visual_manager_14 = Python(IN[0]=output_17.RefOutput_geoColor, IN[1]=visual_켜기_끄기_14)  # CPython3; same code as visual_manager

# group: <Func 2> Steel Structure Plates
code_block_65 = CodeBlock { "TargetElements"; }
# note: <Func>
valueAtKey_13 = DesignScript.Builtin.Dictionary.ValueAtKey(dictionary=value_for_import_from_others_12.MainInput, key=code_block_65)

# group: Select Target Family Element And Connected WorkMasters
code_block_66 = CodeBlock { 4; }
select_target_family_element_and_5 = Python(IN[0]=set_up_all_element_inform_as, IN[1]=code_block_66)  # "Select Target Family Element And Connected WorkMasters"; CPython3; same code as select_target_family_element_and

watch_5 = Watch(select_target_family_element_and_5)

# group: Output Manager
output_18 = CodeBlock { MainOutput; RefOutput_geoColor; }  # unwired: MainOutput, RefOutput_geoColor
reference_output_18 = CodeBlock { ref; }  # unwired: ref

# group: Visual Manager
visual_켜기_끄기_15 = BoolSelector(false)
visual_manager_15 = Python(IN[0]=output_18.RefOutput_geoColor, IN[1]=visual_켜기_끄기_15)  # CPython3; same code as visual_manager

# group: Output Manager
output_19 = CodeBlock { MainOutput; RefOutput_geoColor; }  # unwired: MainOutput, RefOutput_geoColor
reference_output_19 = CodeBlock { ref; }  # unwired: ref

# group: Visual Manager
visual_켜기_끄기_16 = BoolSelector(false)
visual_manager_16 = Python(IN[0]=output_19.RefOutput_geoColor, IN[1]=visual_켜기_끄기_16)  # CPython3; same code as visual_manager

# group: Output Manager
output_20 = CodeBlock { MainOutput; RefOutput_geoColor; }  # unwired: MainOutput, RefOutput_geoColor
reference_output_20 = CodeBlock { ref; }  # unwired: ref

# group: Visual Manager
visual_켜기_끄기_17 = BoolSelector(false)
visual_manager_17 = Python(IN[0]=output_20.RefOutput_geoColor, IN[1]=visual_켜기_끄기_17)  # CPython3; same code as visual_manager

code_block_67 = CodeBlock(i=select_target_family_element_and_5) { i; }
code_block_68 = CodeBlock(i=code_block_67) { i; }

# group: Input Manager
value_for_import_from_others_14 = CodeBlock(MainInput=code_block_68) { MainInput; RefInput1; RefInput2; }  # unwired: RefInput1, RefInput2

# group: <Func 1> Steel Structure Girth & Purlin Weight
code_block_69 = CodeBlock { "TargetElements"; }
# note: <Func>
valueAtKey_14 = DesignScript.Builtin.Dictionary.ValueAtKey(dictionary=value_for_import_from_others_14.MainInput, key=code_block_69)

code_block_70 = CodeBlock { "Length"; "Mass per Unit Length"; "Surface Area"; }
getParameterValueByName_6 = Element.GetParameterValueByName(element=valueAtKey_14, parameterName=code_block_70.out0)
code_block_71 = CodeBlock(a=getParameterValueByName_6) { a/1000; }
elementType_2 = Element.ElementType(element=valueAtKey_14)
getParameterValueByName_7 = Element.GetParameterValueByName(element=elementType_2, parameterName=code_block_70.out1)
mul_5 = code_block_71 * getParameterValueByName_7
code_block_72 = CodeBlock(a=mul_5) { a/1000; }

# group: Output Manager
reference_output_21 = CodeBlock(ref=code_block_72) { ref; }
output_21 = CodeBlock { MainOutput; RefOutput_geoColor; }  # unwired: MainOutput, RefOutput_geoColor

# group: Input Manager
value_for_import_from_others_15 = CodeBlock(MainInput=code_block_68, RefInput1=reference_output_21) { MainInput; RefInput1; RefInput2; }  # unwired: RefInput2

# group: <Func 3> Steel Structure Common Bolt&Nuts
code_block_73 = CodeBlock { "TargetElements"; }
# note: <Func>
valueAtKey_15 = DesignScript.Builtin.Dictionary.ValueAtKey(dictionary=value_for_import_from_others_15.MainInput, key=code_block_73)

# group: Visual Manager
visual_켜기_끄기_18 = BoolSelector(false)
visual_manager_18 = Python(IN[0]=output_21.RefOutput_geoColor, IN[1]=visual_켜기_끄기_18)  # CPython3; same code as visual_manager

# group: Output Manager
output_22 = CodeBlock { MainOutput; RefOutput_geoColor; }  # unwired: MainOutput, RefOutput_geoColor
reference_output_22 = CodeBlock { ref; }  # unwired: ref

# group: Visual Manager
visual_켜기_끄기_19 = BoolSelector(false)
visual_manager_19 = Python(IN[0]=output_22.RefOutput_geoColor, IN[1]=visual_켜기_끄기_19)  # CPython3; same code as visual_manager

# group: Select Target Family Element And Connected WorkMasters
code_block_74 = CodeBlock { 5; }
select_target_family_element_and_6 = Python(IN[0]=set_up_all_element_inform_as, IN[1]=code_block_74)  # "Select Target Family Element And Connected WorkMasters"; CPython3; same code as select_target_family_element_and

watch_6 = Watch(select_target_family_element_and_6)

# group: Output Manager
output_23 = CodeBlock { MainOutput; RefOutput_geoColor; }  # unwired: MainOutput, RefOutput_geoColor
reference_output_23 = CodeBlock { ref; }  # unwired: ref

# group: Visual Manager
visual_켜기_끄기_20 = BoolSelector(false)
visual_manager_20 = Python(IN[0]=output_23.RefOutput_geoColor, IN[1]=visual_켜기_끄기_20)  # CPython3; same code as visual_manager

# group: Output Manager
reference_output_24 = CodeBlock { ref; }  # unwired: ref
output_24 = CodeBlock { MainOutput; RefOutput_geoColor; }  # unwired: MainOutput, RefOutput_geoColor

# group: Output Manager
output_25 = CodeBlock { MainOutput; RefOutput_geoColor; }  # unwired: MainOutput, RefOutput_geoColor
reference_output_25 = CodeBlock { ref; }  # unwired: ref

# group: Visual Manager
visual_켜기_끄기_21 = BoolSelector(false)
visual_manager_21 = Python(IN[0]=output_25.RefOutput_geoColor, IN[1]=visual_켜기_끄기_21)  # CPython3; same code as visual_manager

# group: Output Manager
output_26 = CodeBlock { MainOutput; RefOutput_geoColor; }  # unwired: MainOutput, RefOutput_geoColor
reference_output_26 = CodeBlock { ref; }  # unwired: ref

# group: Visual Manager
visual_켜기_끄기_22 = BoolSelector(false)
visual_manager_22 = Python(IN[0]=output_26.RefOutput_geoColor, IN[1]=visual_켜기_끄기_22)  # CPython3; same code as visual_manager

code_block_75 = CodeBlock(i=select_target_family_element_and_6) { i; }

# group: Input Manager
value_for_import_from_others_16 = CodeBlock(MainInput=code_block_75) { MainInput; RefInput1; RefInput2; }  # unwired: RefInput1, RefInput2

# group: <Func 1> Steel Structure Weight
code_block_76 = CodeBlock { "TargetElements"; }
# note: <Func>
valueAtKey_16 = DesignScript.Builtin.Dictionary.ValueAtKey(dictionary=value_for_import_from_others_16.MainInput, key=code_block_76)

code_block_77 = CodeBlock { "Length"; "Mass per Unit Length"; "Surface Area"; }
getParameterValueByName_8 = Element.GetParameterValueByName(element=valueAtKey_16, parameterName=code_block_77.out0)
code_block_78 = CodeBlock(a=getParameterValueByName_8) { a/1000; }
elementType_3 = Element.ElementType(element=valueAtKey_16)
getParameterValueByName_9 = Element.GetParameterValueByName(element=elementType_3, parameterName=code_block_77.out1)
mul_6 = code_block_78 * getParameterValueByName_9
code_block_79 = CodeBlock(a=mul_6) { a/1000; }

# group: Output Manager
output_27 = CodeBlock { MainOutput; RefOutput_geoColor; }  # unwired: MainOutput, RefOutput_geoColor
reference_output_27 = CodeBlock(ref=code_block_79) { ref; }

# group: Visual Manager
visual_켜기_끄기_23 = BoolSelector(false)
visual_manager_23 = Python(IN[0]=output_27.RefOutput_geoColor, IN[1]=visual_켜기_끄기_23)  # CPython3; same code as visual_manager

# group: Input Manager
value_for_import_from_others_17 = CodeBlock(MainInput=code_block_75, RefInput1=reference_output_27) { MainInput; RefInput1; RefInput2; }  # unwired: RefInput2

# group: <Func 3> Steel Structure Strength Bolt&Nuts
code_block_80 = CodeBlock { "TargetElements"; }
# note: <Func>
valueAtKey_17 = DesignScript.Builtin.Dictionary.ValueAtKey(dictionary=value_for_import_from_others_17.MainInput, key=code_block_80)

# group: Visual Manager
visual_켜기_끄기_24 = BoolSelector(false)
visual_manager_24 = Python(IN[0]=output_24.RefOutput_geoColor, IN[1]=visual_켜기_끄기_24)  # CPython3; same code as visual_manager

code_block_81 = CodeBlock(Weight=value_for_import_from_others_12.RefInput1) { Weight; }
str_plate_ratio_확인 = DoubleInput(0)  # graph input
code_block_82 = CodeBlock(a=code_block_81, b=str_plate_ratio_확인) { a*b; }

# group: Input Manager
value_for_import_from_others_18 = CodeBlock(MainInput=code_block_59) { MainInput; RefInput1; RefInput2; }  # unwired: RefInput1, RefInput2

# group: <Func 3> Steel Structure Painting/Coating
code_block_83 = CodeBlock { "TargetElements"; }
# note: <Func>
valueAtKey_18 = DesignScript.Builtin.Dictionary.ValueAtKey(dictionary=value_for_import_from_others_18.MainInput, key=code_block_83)

code_block_84 = CodeBlock { "Length"; "Mass per Unit Length"; "Surface Area"; }
getParameterValueByName_10 = Element.GetParameterValueByName(element=valueAtKey_18, parameterName=code_block_84.out0)
code_block_85 = CodeBlock(a=getParameterValueByName_10) { a/1000; }
elementType_4 = Element.ElementType(element=valueAtKey_18)
getParameterValueByName_11 = Element.GetParameterValueByName(element=elementType_4, parameterName=code_block_84.out2)
mul_7 = code_block_85 * getParameterValueByName_11
code_block_86 = CodeBlock(Weight=value_for_import_from_others_13.RefInput1) { Weight; }
strength_bolt_ratio_확인 = DoubleInput(0)  # graph input
code_block_87 = CodeBlock(a=code_block_86, b=strength_bolt_ratio_확인) { a*b; }

# group: Input Manager
value_for_import_from_others_19 = CodeBlock(MainInput=code_block_59) { MainInput; RefInput1; RefInput2; }  # unwired: RefInput1, RefInput2

# group: <Func 5> Steel Structure Weight
code_block_88 = CodeBlock { "TargetElements"; }
# note: <Func>
valueAtKey_19 = DesignScript.Builtin.Dictionary.ValueAtKey(dictionary=value_for_import_from_others_19.MainInput, key=code_block_88)

code_block_89 = CodeBlock { "Length"; "Mass per Unit Length"; "Surface Area"; }
getParameterValueByName_12 = Element.GetParameterValueByName(element=valueAtKey_19, parameterName=code_block_89.out0)
code_block_90 = CodeBlock(a=getParameterValueByName_12) { a/1000; }
elementType_5 = Element.ElementType(element=valueAtKey_19)
getParameterValueByName_13 = Element.GetParameterValueByName(element=elementType_5, parameterName=code_block_89.out1)
mul_8 = code_block_90 * getParameterValueByName_13
code_block_91 = CodeBlock(a=mul_8) { a/1000; }

# group: Input Manager
value_for_import_from_others_20 = CodeBlock(MainInput=code_block_59) { MainInput; RefInput1; RefInput2; }  # unwired: RefInput1, RefInput2

# group: <Func 6> Steel Structure Painting
code_block_92 = CodeBlock { "TargetElements"; }
# note: <Func>
valueAtKey_20 = DesignScript.Builtin.Dictionary.ValueAtKey(dictionary=value_for_import_from_others_20.MainInput, key=code_block_92)

code_block_93 = CodeBlock { "Length"; "Mass per Unit Length"; "Surface Area"; }
getParameterValueByName_14 = Element.GetParameterValueByName(element=valueAtKey_20, parameterName=code_block_93.out0)
code_block_94 = CodeBlock(a=getParameterValueByName_14) { a/1000; }
elementType_6 = Element.ElementType(element=valueAtKey_20)
getParameterValueByName_15 = Element.GetParameterValueByName(element=elementType_6, parameterName=code_block_93.out2)
mul_9 = code_block_94 * getParameterValueByName_15

# group: Input Manager
value_for_import_from_others_21 = CodeBlock(MainInput=code_block_59) { MainInput; RefInput1; RefInput2; }  # unwired: RefInput1, RefInput2

# group: <Func 10> Steel Structure Fire Proofing Work
code_block_95 = CodeBlock { "TargetElements"; }
# note: <Func>
valueAtKey_21 = DesignScript.Builtin.Dictionary.ValueAtKey(dictionary=value_for_import_from_others_21.MainInput, key=code_block_95)

code_block_96 = CodeBlock { "Length"; "Mass per Unit Length"; "Surface Area"; }
getParameterValueByName_16 = Element.GetParameterValueByName(element=valueAtKey_21, parameterName=code_block_96.out0)
code_block_97 = CodeBlock(a=getParameterValueByName_16) { a/1000; }
elementType_7 = Element.ElementType(element=valueAtKey_21)
getParameterValueByName_17 = Element.GetParameterValueByName(element=elementType_7, parameterName=code_block_96.out2)
mul_10 = code_block_97 * getParameterValueByName_17

# group: Input Manager
value_for_import_from_others_22 = CodeBlock(MainInput=code_block_68) { MainInput; RefInput1; RefInput2; }  # unwired: RefInput1, RefInput2

# group: <Func 2> Steel Structure Painting/Coating
code_block_98 = CodeBlock { "TargetElements"; }
# note: <Func>
valueAtKey_22 = DesignScript.Builtin.Dictionary.ValueAtKey(dictionary=value_for_import_from_others_22.MainInput, key=code_block_98)

code_block_99 = CodeBlock { "Length"; "Mass per Unit Length"; "Surface Area"; }
getParameterValueByName_18 = Element.GetParameterValueByName(element=valueAtKey_22, parameterName=code_block_99.out0)
code_block_100 = CodeBlock(a=getParameterValueByName_18) { a/1000; }
elementType_8 = Element.ElementType(element=valueAtKey_22)
getParameterValueByName_19 = Element.GetParameterValueByName(element=elementType_8, parameterName=code_block_99.out2)
mul_11 = code_block_100 * getParameterValueByName_19
code_block_101 = CodeBlock(Weight=value_for_import_from_others_15.RefInput1) { Weight; }
strength_bolt_ratio_확인_2 = DoubleInput(0)  # graph input
code_block_102 = CodeBlock(a=code_block_101, b=strength_bolt_ratio_확인_2) { a*b; }

# group: Input Manager
value_for_import_from_others_23 = CodeBlock(MainInput=code_block_68) { MainInput; RefInput1; RefInput2; }  # unwired: RefInput1, RefInput2

# group: <Func 4> Steel Structure Girth & Purlin Weight
code_block_103 = CodeBlock { "TargetElements"; }
# note: <Func>
valueAtKey_23 = DesignScript.Builtin.Dictionary.ValueAtKey(dictionary=value_for_import_from_others_23.MainInput, key=code_block_103)

code_block_104 = CodeBlock { "Length"; "Mass per Unit Length"; "Surface Area"; }
getParameterValueByName_20 = Element.GetParameterValueByName(element=valueAtKey_23, parameterName=code_block_104.out0)
code_block_105 = CodeBlock(a=getParameterValueByName_20) { a/1000; }
elementType_9 = Element.ElementType(element=valueAtKey_23)
getParameterValueByName_21 = Element.GetParameterValueByName(element=elementType_9, parameterName=code_block_104.out1)
mul_12 = code_block_105 * getParameterValueByName_21
code_block_106 = CodeBlock(a=mul_12) { a/1000; }

# group: Input Manager
value_for_import_from_others_24 = CodeBlock(MainInput=code_block_68) { MainInput; RefInput1; RefInput2; }  # unwired: RefInput1, RefInput2

# group: <Func 5> Steel Structure Painting
code_block_107 = CodeBlock { "TargetElements"; }
# note: <Func>
valueAtKey_24 = DesignScript.Builtin.Dictionary.ValueAtKey(dictionary=value_for_import_from_others_24.MainInput, key=code_block_107)

code_block_108 = CodeBlock { "Length"; "Mass per Unit Length"; "Surface Area"; }
getParameterValueByName_22 = Element.GetParameterValueByName(element=valueAtKey_24, parameterName=code_block_108.out0)
code_block_109 = CodeBlock(a=getParameterValueByName_22) { a/1000; }
elementType_10 = Element.ElementType(element=valueAtKey_24)
getParameterValueByName_23 = Element.GetParameterValueByName(element=elementType_10, parameterName=code_block_108.out2)
mul_13 = code_block_109 * getParameterValueByName_23

# group: Input Manager
value_for_import_from_others_25 = CodeBlock(MainInput=code_block_68, RefInput1=reference_output_21) { MainInput; RefInput1; RefInput2; }  # unwired: RefInput2

# group: Output Manager
output_28 = CodeBlock { MainOutput; RefOutput_geoColor; }  # unwired: MainOutput, RefOutput_geoColor
reference_output_28 = CodeBlock(ref=value_for_import_from_others_25.RefInput1) { ref; }

# group: Visual Manager
visual_켜기_끄기_25 = BoolSelector(false)
visual_manager_25 = Python(IN[0]=output_28.RefOutput_geoColor, IN[1]=visual_켜기_끄기_25)  # CPython3; same code as visual_manager

code_block_110 = CodeBlock(Weight=value_for_import_from_others_25.RefInput1) { Weight; }
str_plate_ratio_확인_2 = DoubleInput(0)  # graph input
code_block_111 = CodeBlock(a=code_block_110, b=str_plate_ratio_확인_2) { a*b; }

# group: <Func 00> Steel Structure Plates
code_block_112 = CodeBlock { "TargetElements"; }
# note: <Func>
valueAtKey_25 = DesignScript.Builtin.Dictionary.ValueAtKey(dictionary=value_for_import_from_others_25.MainInput, key=code_block_112)

# group: Input Manager
value_for_import_from_others_26 = CodeBlock(MainInput=code_block_75) { MainInput; RefInput1; RefInput2; }  # unwired: RefInput1, RefInput2

# group: <Func 2> Steel Structure Painting/Coating
code_block_113 = CodeBlock { "TargetElements"; }
# note: <Func>
valueAtKey_26 = DesignScript.Builtin.Dictionary.ValueAtKey(dictionary=value_for_import_from_others_26.MainInput, key=code_block_113)

code_block_114 = CodeBlock { "Length"; "Mass per Unit Length"; "Surface Area"; }
getParameterValueByName_24 = Element.GetParameterValueByName(element=valueAtKey_26, parameterName=code_block_114.out0)
code_block_115 = CodeBlock(a=getParameterValueByName_24) { a/1000; }
elementType_11 = Element.ElementType(element=valueAtKey_26)
getParameterValueByName_25 = Element.GetParameterValueByName(element=elementType_11, parameterName=code_block_114.out2)
mul_14 = code_block_115 * getParameterValueByName_25
code_block_116 = CodeBlock(Weight=value_for_import_from_others_17.RefInput1) { Weight; }
strength_bolt_ratio_확인_3 = DoubleInput(0)  # graph input
code_block_117 = CodeBlock(a=code_block_116, b=strength_bolt_ratio_확인_3) { a*b; }

# group: Input Manager
value_for_import_from_others_27 = CodeBlock(MainInput=code_block_75) { MainInput; RefInput1; RefInput2; }  # unwired: RefInput1, RefInput2

# group: <Func 4> Steel Structure Weight
code_block_118 = CodeBlock { "TargetElements"; }
# note: <Func>
valueAtKey_27 = DesignScript.Builtin.Dictionary.ValueAtKey(dictionary=value_for_import_from_others_27.MainInput, key=code_block_118)

code_block_119 = CodeBlock { "Length"; "Mass per Unit Length"; "Surface Area"; }
getParameterValueByName_26 = Element.GetParameterValueByName(element=valueAtKey_27, parameterName=code_block_119.out0)
code_block_120 = CodeBlock(a=getParameterValueByName_26) { a/1000; }
elementType_12 = Element.ElementType(element=valueAtKey_27)
getParameterValueByName_27 = Element.GetParameterValueByName(element=elementType_12, parameterName=code_block_119.out1)
mul_15 = code_block_120 * getParameterValueByName_27
code_block_121 = CodeBlock(a=mul_15) { a/1000; }

# group: Input Manager
value_for_import_from_others_28 = CodeBlock(MainInput=code_block_75) { MainInput; RefInput1; RefInput2; }  # unwired: RefInput1, RefInput2

# group: <Func 5> Steel Structure Painting
code_block_122 = CodeBlock { "TargetElements"; }
# note: <Func>
valueAtKey_28 = DesignScript.Builtin.Dictionary.ValueAtKey(dictionary=value_for_import_from_others_28.MainInput, key=code_block_122)

code_block_123 = CodeBlock { "Length"; "Mass per Unit Length"; "Surface Area"; }
getParameterValueByName_28 = Element.GetParameterValueByName(element=valueAtKey_28, parameterName=code_block_123.out0)
code_block_124 = CodeBlock(a=getParameterValueByName_28) { a/1000; }
elementType_13 = Element.ElementType(element=valueAtKey_28)
getParameterValueByName_29 = Element.GetParameterValueByName(element=elementType_13, parameterName=code_block_123.out2)
mul_16 = code_block_124 * getParameterValueByName_29
code_block_125 = CodeBlock(i=select_target_family_element_and) { i; }

# group: Input Manager
value_for_import_from_others_29 = CodeBlock(MainInput=code_block_125) { MainInput; RefInput1; RefInput2; }  # unwired: RefInput1, RefInput2

# group: <Func 9>Lean Concrete
code_block_126 = CodeBlock { "TargetElements"; }
valueAtKey_29 = DesignScript.Builtin.Dictionary.ValueAtKey(dictionary=value_for_import_from_others_29.MainInput, key=code_block_126)
code_block_127 = CodeBlock { 0; 100; }
# note: <Func>
createLeanConcrete = Custom[CreateLeanConcrete](Element=valueAtKey_29, leanOffset=code_block_127.out0, leanThick=code_block_127.out1)  # CreateLeanConcreteForISOFDN
volume_4 = Solid.Volume(solid=createLeanConcrete.Solid)
code_block_128 = CodeBlock(i=volume_4) { Math.Round(List.Flatten(i)/1000000000, 2); }
code_block_129 = CodeBlock { "M3"; }
count_11 = List.Count(list=code_block_128)
ofRepeatedItem_11 = List.OfRepeatedItem(item=code_block_129, amount=count_11)
code_block_130 = CodeBlock(FuncValues=code_block_128, FuncValuesUnit=ofRepeatedItem_11)  # same code as code_block_7

# group: Output Manager
reference_output_29 = CodeBlock(ref=createLeanConcrete.Solid) { ref; }
output_29 = CodeBlock(MainOutput=code_block_130, RefOutput_geoColor=createLeanConcrete.Solid) { MainOutput; RefOutput_geoColor; }

# group: Input Manager
value_for_import_from_others_30 = CodeBlock(MainInput=code_block_125, RefInput1=reference_output_29) { MainInput; RefInput1; RefInput2; }  # unwired: RefInput2

# group: <Func 4> Excavation (SOG 한정)
levels = Levels("G.L")  # graph input
elevation = Level.Elevation(level=levels)
code_block_131 = CodeBlock { "TargetElements"; }
valueAtKey_30 = DesignScript.Builtin.Dictionary.ValueAtKey(dictionary=value_for_import_from_others_30.MainInput, key=code_block_131)
code_block_132 = CodeBlock { "Elevation at Bottom"; }
getParameterValueByName_30 = Element.GetParameterValueByName(element=valueAtKey_30, parameterName=code_block_132)
린_콘크리트_하부까지의_길이_추출_최하단 = Python(IN[0]=value_for_import_from_others_30.RefInput1)  # CPython3
# ---------- 린_콘크리트_하부까지의_길이_추출_최하단.python (22 lines) ----------
# Load the Python Standard and DesignScript Libraries
import sys
import clr
clr.AddReference('ProtoGeometry')
from Autodesk.DesignScript.Geometry import *

# The inputs to this node will be stored as a list in the IN variables.
dataEnteringNode = IN
inputs = IN[0]

# Place your code below this line

def findThickness(i):
    minPt_Z = BoundingBox.ByGeometry(i).MinPoint.Z
    maxPt_Z = BoundingBox.ByGeometry(i).MaxPoint.Z
    result = maxPt_Z - minPt_Z
    return result

thicknessByInput = list(map(findThickness, inputs))

# Assign your output to the OUT variable.
OUT = thicknessByInput
# ----------------------------------------
code_block_133 = CodeBlock(기초하단=getParameterValueByName_30, 린콘크리트하단=린_콘크리트_하부까지의_길이_추출_최하단) { 기초하단-린콘크리트하단; }
sub = elevation - code_block_133
code_block_134 = CodeBlock(i=sub) { i<0?true:false; }
code_block_135 = CodeBlock { 0; }
flatten = List.Flatten(list=value_for_import_from_others_30.RefInput1)
하부_surface_추출 = Python(IN[0]=flatten)  # CPython3
# ---------- 하부_surface_추출.python (26 lines) ----------
# Load the Python Standard and DesignScript Libraries
import sys
import clr
import itertools
clr.AddReference('ProtoGeometry')
from Autodesk.DesignScript.Geometry import *

# The inputs to this node will be stored as a list in the IN variables.
dataEnteringNode = IN
input_elements = IN[0]

# Place your code below this line

srfs_input_elements = list(map(lambda x: x.Explode(), input_elements))

#srfs_input_flatten = list(itertools.chain(*srfs_input_elements))

def func_findZ_normalAtParma(srf):
    return srf.NormalAtParameter(0.5,0.5).Z
srfs_below = list(map(lambda y: filter(lambda x: func_findZ_normalAtParma(x) == -1, y), srfs_input_elements))

result = srfs_below


# Assign your output to the OUT variable.
OUT = result
# ----------------------------------------
flatten_2 = List.Flatten(list=하부_surface_추출)
perimeterCurves = Surface.PerimeterCurves(surface=flatten_2)
byJoinedCurves = PolyCurve.ByJoinedCurves(curves=perimeterCurves)
code_block_136 = CodeBlock { _ExcavOffsetBottom: var[]..[] = 300; }
offset = Curve.Offset(curve=byJoinedCurves, distance=code_block_136)
flatten_3 = List.Flatten(list=offset)
flatten_4 = List.Flatten(list=sub)
translate = Geometry.Translate(geometry=offset, zTranslation=flatten_4)
경사_비율_입력_1_x_for_isofdn = DoubleInput(2)  # graph input
code_block_137 = CodeBlock(ElevationatBottom=flatten_4, 비율=경사_비율_입력_1_x_for_isofdn) { ElevationatBottom/비율; }
offset_2 = Curve.Offset(curve=translate, distance=code_block_137)
flatten_5 = List.Flatten(list=offset_2)
list_create = List.Create(item0=flatten_3, item1=flatten_5)
transpose = List.Transpose(lists=list_create)
byLoft = Solid.ByLoft(crossSections=transpose)
터파기_형상_겹침_해소 = Python(IN[0]=byLoft)  # CPython3
# ---------- 터파기_형상_겹침_해소.python (29 lines) ----------
# Load the Python Standard and DesignScript Libraries
import sys
import clr
clr.AddReference('ProtoGeometry')
from Autodesk.DesignScript.Geometry import *

# The inputs to this node will be stored as a list in the IN variables.
dataEnteringNode = IN
inputs = IN[0]
result = []
# Place your code below this line

for x in range(len(inputs)):
    if x < len(inputs)-1:
        temp = []
        apply = inputs[x]
        for y in range(x,len(inputs)):
            if apply.DoesIntersect(inputs[y]):
                apply = apply.Split(inputs[y])[0]
                temp.append(apply)
            else:
                apply = apply
                temp.append(apply)
        result.append(temp[-1])
    elif x == len(inputs)-1:
        result.append(inputs[x])

# Assign your output to the OUT variable.
OUT = result
# ----------------------------------------
volume_5 = Solid.Volume(solid=터파기_형상_겹침_해소)
code_block_138 = CodeBlock(i=volume_5) { Math.Round(List.Flatten(i)/1000000000, 2); }
if_ = If(test=code_block_134, true=code_block_135, false=code_block_138)
code_block_139 = CodeBlock { "M3"; }
count_12 = List.Count(list=code_block_138)
ofRepeatedItem_12 = List.OfRepeatedItem(item=code_block_139, amount=count_12)
code_block_140 = CodeBlock(FuncValues=if_, FuncValuesUnit=ofRepeatedItem_12)  # same code as code_block_7
color_palette = ColorPalette({R: 210, G: 105, B: 30, A: 135})
byGeometryColor = Modifiers.GeometryColor.ByGeometryColor(geometry=터파기_형상_겹침_해소, color=color_palette)
forRefOutput = CodeBlock(MainOutput=code_block_140, geoColor=byGeometryColor, 터파기형상=터파기_형상_겹침_해소)
# ---------- forRefOutput.designscript (5 lines) ----------
{
"MainOutput": MainOutput,
"geoColor": geoColor,
"터파기형상": 터파기형상
};
# ----------------------------------------

# group: Output Manager
output_30 = CodeBlock(MainOutput=forRefOutput, RefOutput_geoColor=byGeometryColor) { MainOutput; RefOutput_geoColor; }
reference_output_30 = CodeBlock(ref=터파기_형상_겹침_해소, ref2=if_) { ref; ref2; }

# group: Visual Manager
visual_켜기_끄기_26 = BoolSelector(false)
visual_manager_26 = Python(IN[0]=output_30.RefOutput_geoColor, IN[1]=visual_켜기_끄기_26)  # CPython3; same code as visual_manager

# group: Input Manager
value_for_import_from_others_31 = CodeBlock(MainInput=code_block_125, RefInput1=reference_output_29, RefInput2=reference_output_30.ref, RefInput3=geometry) { MainInput; RefInput1; RefInput2; RefInput3; }

# group: <Func 2> Backfill
value_for_import_from_others_32 = CodeBlock(슬라브형상=value_for_import_from_others_31.RefInput3) { 슬라브형상; }
flatten_6 = List.Flatten(list=value_for_import_from_others_32)
value_for_import_from_others_33 = CodeBlock(터파기형상=value_for_import_from_others_31.RefInput2) { 터파기형상; }
flatten_7 = List.Flatten(list=value_for_import_from_others_33)
doesIntersect = Geometry.DoesIntersect(geometry=flatten_7, other=flatten_6, lacing=CrossProduct)
filterByBoolMask_5 = List.FilterByBoolMask(list=flatten_6, mask=doesIntersect@L2)
flatten_8 = List.Flatten(list=filterByBoolMask_5.in)
volume_6 = Solid.Volume(solid=flatten_7)
watch_7 = Watch(volume_6)
code_block_141 = CodeBlock(i=watch_7) { Math.Round(List.Flatten(i)/1000000000, 2); }
code_block_142 = CodeBlock { "M3"; }
count_13 = List.Count(list=watch_7)
ofRepeatedItem_13 = List.OfRepeatedItem(item=code_block_142, amount=count_13)
# note: 터파기 물량ㅈ에서 콘크리트, 린 기둥 물량 빼기
code_block_143 = CodeBlock(FuncValues=code_block_141, FuncValuesUnit=ofRepeatedItem_13)  # same code as code_block_7

# group: Output Manager
reference_output_31 = CodeBlock { ref; }  # unwired: ref
output_31 = CodeBlock(MainOutput=code_block_143) { MainOutput; RefOutput_geoColor; }  # unwired: RefOutput_geoColor

watch_8 = Watch(output_30.MainOutput)

# group: Input Manager
value_for_import_from_others_34 = CodeBlock(MainInput=code_block_125) { MainInput; RefInput1; RefInput2; }  # unwired: RefInput1, RefInput2

# group: <Func 3> PE Sheet
code_block_144 = CodeBlock { "TargetElements"; }
valueAtKey_31 = DesignScript.Builtin.Dictionary.ValueAtKey(dictionary=value_for_import_from_others_34.MainInput, key=code_block_144)
# note: <Func>
createLeanConcrete_2 = Custom[CreateLeanConcrete](Element=valueAtKey_31)
area_5 = Surface.Area(surface=createLeanConcrete_2.Surface)
code_block_145 = CodeBlock(i=area_5) { Math.Round(List.Flatten(i)/1000000, 2); }
code_block_146 = CodeBlock { "M2"; }
count_14 = List.Count(list=code_block_145)
ofRepeatedItem_14 = List.OfRepeatedItem(item=code_block_146, amount=count_14)
code_block_147 = CodeBlock(FuncValues=code_block_145, FuncValuesUnit=ofRepeatedItem_14)  # same code as code_block_7

# group: Output Manager
output_32 = CodeBlock(MainOutput=code_block_147) { MainOutput; RefOutput_geoColor; }  # unwired: RefOutput_geoColor
reference_output_32 = CodeBlock { ref; }  # unwired: ref

# group: Input Manager
value_for_import_from_others_35 = CodeBlock(MainInput=code_block_125, RefInput1=reference_output_30.ref2) { MainInput; RefInput1; RefInput2; }  # unwired: RefInput2

# group: <Func 6>Disposal
code_block_148 = CodeBlock(i=value_for_import_from_others_35.RefInput1) { i==0?true:false; }
code_block_149 = CodeBlock { 0; }
# note: <Func>
if_2 = If(test=code_block_148, true=code_block_149, false=value_for_import_from_others_35.RefInput1)
code_block_150 = CodeBlock(i=if_2) { Math.Round(List.Flatten(i)/1000000000, 2); }
code_block_151 = CodeBlock { "M3"; }
count_15 = List.Count(list=code_block_150)
ofRepeatedItem_15 = List.OfRepeatedItem(item=code_block_151, amount=count_15)
code_block_152 = CodeBlock(FuncValues=code_block_150, FuncValuesUnit=ofRepeatedItem_15)  # same code as code_block_7
code_block_153 = CodeBlock { "TargetElements"; }
valueAtKey_32 = DesignScript.Builtin.Dictionary.ValueAtKey(dictionary=value_for_import_from_others_35.MainInput, key=code_block_153)
count_16 = List.Count(list=valueAtKey_32@L1)

# group: Output Manager
output_33 = CodeBlock(MainOutput=code_block_152) { MainOutput; RefOutput_geoColor; }  # unwired: RefOutput_geoColor
reference_output_33 = CodeBlock { ref; }  # unwired: ref

# group: Input Manager
value_for_import_from_others_36 = CodeBlock(MainInput=code_block_125) { MainInput; RefInput1; RefInput2; }  # unwired: RefInput1, RefInput2

# group: <Func 7>Base Course
code_block_154 = CodeBlock { "TargetElements"; }
valueAtKey_33 = DesignScript.Builtin.Dictionary.ValueAtKey(dictionary=value_for_import_from_others_36.MainInput, key=code_block_154)
code_block_155 = CodeBlock { 300; 100; }
# note: <Func>
createBaseCourseSurfaces = Custom[CreateBaseCourseSurfaces](Element=valueAtKey_33, BaseCourseOffsetBottom=code_block_155.out0, leanThick=code_block_155.out1)  # CreateBaseCourseSurfaces
area_6 = Surface.Area(surface=createBaseCourseSurfaces.Surface)
code_block_156 = CodeBlock(i=area_6) { Math.Round(List.Flatten(i)/1000000, 2); }
code_block_157 = CodeBlock { "M2"; }
count_17 = List.Count(list=code_block_156)
ofRepeatedItem_16 = List.OfRepeatedItem(item=code_block_157, amount=count_17)
code_block_158 = CodeBlock(FuncValues=code_block_156, FuncValuesUnit=ofRepeatedItem_16)  # same code as code_block_7

# group: Output Manager
output_34 = CodeBlock(MainOutput=code_block_158) { MainOutput; RefOutput_geoColor; }  # unwired: RefOutput_geoColor
reference_output_34 = CodeBlock(ref=createBaseCourseSurfaces.Surface) { ref; }

join = List.Join(list3=output_32.MainOutput, list4=output_30.MainOutput, list5=output_31.MainOutput, list6=output_33.MainOutput, list7=output_34.MainOutput, list9=output_29.MainOutput)  # unwired: list0, list1, list2, list8, list10

# group: Visual Manager
visual_켜기_끄기_27 = BoolSelector(false)
visual_manager_27 = Python(IN[0]=output_29.RefOutput_geoColor, IN[1]=visual_켜기_끄기_27)  # CPython3; same code as visual_manager
