# Dynamo graph 실제도면 적용_rulecheck.dyn (Dynamo 2.10.1.3976)

# group: //User객체, Pipe객체 분리
element_types = ElementTypes("ImportInstance")
all_elements_of_type = ElementsOfType(element_type=element_types)
geometry = Element.Geometry(element=all_elements_of_type)
python_script = Python(IN[0]=geometry)  # IronPython2
# ---------- python_script.python (13 lines) ----------
# Load the Python Standard and DesignScript Libraries
import sys
import clr
clr.AddReference('ProtoGeometry')
from Autodesk.DesignScript.Geometry import *

test = IN[0]
# The inputs to this node will be stored as a list in the IN variables.
list = [lst for lst in test if lst != []]
# Place your code below this line

# Assign your output to the OUT variable.
OUT = list
# ----------------------------------------
element_types_2 = ElementTypes("Pipe")
all_elements_of_type_2 = ElementsOfType(element_type=element_types_2)
geometry_2 = Element.Geometry(element=all_elements_of_type_2)
flatten = List.Flatten(list=geometry_2)

# group: //Rule_Check Algorithm
python_script_2 = Python(IN[0]=python_script, IN[1]=flatten)  # CPython3
# ---------- python_script_2.python (99 lines) ----------
# Load the Python Standard and DesignScript Libraries
import sys
import clr
clr.AddReference('ProtoGeometry')
from Autodesk.DesignScript.Geometry import *
clr.AddReference('DSCoreNodes')
import DSCore
from DSCore import *


# The inputs to this node will be stored as a list in the IN variables.
stack = 0
def user_count(pipe):
    checked_users=[]
    global stack
    for u in users_list:
        for e in u:
            if Geometry.DoesIntersect(pipe,e) == bool(1):
                stack += 1
                checked_users.append(u)
                break
                
                
    for c in checked_users:
        users_list.remove(c)
	   
				
def check_intersect(pipe):
	filter = []
	try:
		for p in pipes_list:
			filter.append(Geometry.DoesIntersect(pipe,p))
	except:
		for p in pipes_list:
			filter.append(Geometry.DoesIntersect(pipe[0],p))
	next_pipe = List.FilterByBoolMask(pipes_list,filter)['in']
	return next_pipe

def preprocessing(pipe):
	checked_pipes.append(pipe)
	pipes_list.remove(pipe)
	user_count(pipe)

def single_check(pipe):
	preprocessing(pipe)
	next = check_intersect(pipe)
	return next

def multi_check(pipes):
	next = []
	for p in pipes:
		preprocessing(p)
	for p in pipes:
		next.append(check_intersect(p))
	return next



users_list = IN[0]
pipes_list = IN[1]
result = []
error = []
try:
    while List.IsEmpty(users_list) == False:
    
        stack = 0
        checked_pipes = []
    

#Random User 설정
        random_user = users_list[0]

#Random User 와 닿는 pipe 추출
        for u in random_user:
            for p in pipes_list:
                if Geometry.DoesIntersect(u,p) == bool(1):
                    start_pipe = p
            
        next = [start_pipe]

        sequence = True
        while sequence == True:
            if List.IsEmpty(next):
                sequence = False
            elif len(next)>1:
                next = List.Flatten(multi_check(next))
            else:
                next = single_check(next[0])
               
        if stack > 3:
            result.append([checked_pipes])

except:
    error.append([random_user,pipes_list])
    pass
    
 
# Assign your output to the OUT variable.
OUT = [result,error,next]
# ----------------------------------------
code_block = CodeBlock(i=python_script_2) { i[0]; }
flatten_2 = List.Flatten(list=code_block)

# group: //Error 구간 색 변환(적색)
byGeometry = ImportInstance.ByGeometry(geometry=flatten_2)
color_palette = ColorPalette({R: 255, G: 0, B: 0, A: 255})
overrideColorInView = Element.OverrideColorInView(element=byGeometry, color=color_palette)
