# Dynamo graph 20210827_RebarTest.dyn (Dynamo 2.10.1.3976)

categories = Categories("OST_Rebar")
all_elements_of_category = ElementsOfCategory(Category=categories)
parameters = Element.Parameters(element=all_elements_of_category)
solids = Element.Solids(element=all_elements_of_category)
code_block = CodeBlock(i=all_elements_of_category) { i[0]; }
python_script = Python(IN[0]=code_block)  # IronPython2
# ---------- python_script.python (42 lines) ----------
import clr

clr.AddReference('RevitAPI')
from Autodesk.Revit.DB import *
from Autodesk.Revit.DB.Structure import *

clr.AddReference('RevitNodes')
import Revit
clr.ImportExtensions(Revit.GeometryConversion)
clr.ImportExtensions(Revit.Elements)

clr.AddReference('RevitServices')
import RevitServices
from RevitServices.Persistence import DocumentManager

doc = DocumentManager.Instance.CurrentDBDocument
view = doc.ActiveView

#Convert input from dynamo to revit
rebar = UnwrapElement(IN[0])
rebarShp = rebar.GetShapeDrivenAccessor()

#Set options
mpo = MultiplanarOption.IncludeAllMultiplanarCurves

#Get info from rebar
numOfBars = rebar.NumberOfBarPositions
quantity = rebar.Quantity
layoutRule = rebar.LayoutRule

if numOfBars > 1:
	#Find visible bars and get their centerline curves transformed to correct position
	centerlineCurves = []
	for i in range(numOfBars):
		if not rebar.IsBarHidden(view,i):
			posTransform = rebarShp.GetBarPositionTransform(i)
			revitCurve = [c.CreateTransformed(posTransform) for c in rebar.GetCenterlineCurves(0,0,0,mpo,0)]
			centerlineCurves.append([r.ToProtoType(True) for r in revitCurve])
	
else:
	centerlineCurves = [r.ToProtoType(True) for r in rebar.GetCenterlineCurves(0,0,0,mpo,0)]
OUT = centerlineCurves
# ----------------------------------------
shapeOfRebar = Custom[ShapeOfRebar](i=all_elements_of_category)  # ShapeOfRebar
byJoinedCurves = PolyCurve.ByJoinedCurves(curves=shapeOfRebar@L3)
code_block_2 = CodeBlock { 0; }
getItemAtIndex = List.GetItemAtIndex(list=byJoinedCurves, index=code_block_2)
count = List.Count(list=byJoinedCurves)
code_block_3 = CodeBlock(i=count) { 0..i-1; }
code_block_4 = CodeBlock(i=code_block_3) { i>10&&i<20?true:false; }
filterByBoolMask = List.FilterByBoolMask(list=byJoinedCurves, mask=code_block_4)
color_palette = ColorPalette({R: 255, G: 69, B: 0, A: 255})
byGeometryColor = Modifiers.GeometryColor.ByGeometryColor(geometry=filterByBoolMask.in, color=color_palette)
color_palette_2 = ColorPalette({R: 211, G: 211, B: 211, A: 188})
byGeometryColor_2 = Modifiers.GeometryColor.ByGeometryColor(geometry=filterByBoolMask.out, color=color_palette_2)
code_block_5 = CodeBlock { "NumberOfBarPositions"; }
getParameterValueByName = Element.GetParameterValueByName(element=all_elements_of_category, parameterName=code_block_5)
python_script_2 = Python(IN[0]=code_block)  # "Python Script@NumberOfBarPositions"; IronPython2
# ---------- python_script_2.python (22 lines) ----------
# Load the Python Standard and DesignScript Libraries
import sys
import clr
clr.AddReference('ProtoGeometry')
from Autodesk.DesignScript.Geometry import *

# The inputs to this node will be stored as a list in the IN variables.
dataEnteringNode = IN

# Place your code below this line
#Convert input from dynamo to revit
rebar = UnwrapElement(IN[0])
rebarShp = rebar.GetShapeDrivenAccessor()

#Set options
#mpo = MultiplanarOption.IncludeAllMultiplanarCurves

#Get info from rebar
numOfBars = rebar.NumberOfBarPositions

# Assign your output to the OUT variable.
OUT = numOfBars
# ----------------------------------------
