# Dynamo graph 20210728_clock(physics).dyn (Dynamo 2.10.1.3976)

# group: 시계 테두리 만들기
code_block = CodeBlock { Point.ByCoordinates(0,0,0); }
code_block_2 = CodeBlock { 35*600; }
byCenterPointRadius = Circle.ByCenterPointRadius(centerPoint=code_block, radius=code_block_2)
byCurve = ModelCurve.ByCurve(curve=byCenterPointRadius)

# group: 시침간격
code_block_3 = CodeBlock(q=byCenterPointRadius) { q; }
code_block_4 = CodeBlock { 11; }
pointsAtEqualChordLength = Curve.PointsAtEqualChordLength(curve=code_block_3, divisions=code_block_4)
code_block_5 = CodeBlock { Point.ByCoordinates(35*600,0,0); }
join = List.Join(list0=pointsAtEqualChordLength, list1=code_block_5)
reverse = List.Reverse(list=join)
parameterAtPoint = Curve.ParameterAtPoint(curve=code_block_3, point=reverse)
normalAtParameter = Curve.NormalAtParameter(curve=code_block_3, param=parameterAtPoint)
code_block_6 = CodeBlock { 3*600; }
byStartPointDirectionLength = Line.ByStartPointDirectionLength(startPoint=reverse, direction=normalAtParameter, length=code_block_6)
byCurve_2 = ModelCurve.ByCurve(curve=byStartPointDirectionLength)

# group: 분침간격
code_block_7 = CodeBlock(q=byCenterPointRadius) { q; }
code_block_8 = CodeBlock { 59; }
pointsAtEqualChordLength_2 = Curve.PointsAtEqualChordLength(curve=code_block_7, divisions=code_block_8)
parameterAtPoint_2 = Curve.ParameterAtPoint(curve=code_block_7, point=pointsAtEqualChordLength_2)
normalAtParameter_2 = Curve.NormalAtParameter(curve=code_block_7, param=parameterAtPoint_2)
code_block_9 = CodeBlock { 1*600; }
byStartPointDirectionLength_2 = Line.ByStartPointDirectionLength(startPoint=pointsAtEqualChordLength_2, direction=normalAtParameter_2, length=code_block_9)
byCurve_3 = ModelCurve.ByCurve(curve=byStartPointDirectionLength_2)

now = DateTime.Now()
string_from_object = FromObject(obj=now)
code_block_10 = CodeBlock(inputTime=string_from_object)
# ---------- code_block_10.designscript (6 lines) ----------
t1 = inputTime;
str3 = String.Split(t1, [" ", ":"]);
i = str3;
mkSec = Get.ValueAtIndex(i, 4);
mkMin = Get.ValueAtIndex(i, 3);
mkHr = Get.ValueAtIndex(i, 2);
# ----------------------------------------

# group: 분침모듈
code_block_11 = CodeBlock { 1*600; }
code_block_12 = CodeBlock { 20*600; }
code_block_13 = CodeBlock(k=code_block_11, j=code_block_12) { Point.ByCoordinates(0, 0, 0); Point.ByCoordinates(k, j, 1*300); }
code_block_14 = CodeBlock(k=code_block_11, i=code_block_13.out0, j=code_block_13.out1) { Cuboid.Translate(t1,-k/2,0,0); t1 = Cuboid.ByCorners(i,j); }
code_block_15 = CodeBlock { Point.ByCoordinates(0,0,0); }
회전축 = CodeBlock { Vector.Reverse(Vector.ZAxis()); }
code_block_16 = CodeBlock { 6; }
code_block_17 = CodeBlock(i=code_block_10.mkMin, sc=code_block_16) { t1 = i; rDeg = sc * String.ToNumber(t1); }
rotate = Geometry.Rotate(geometry=code_block_14.out0, origin=code_block_15, axis=회전축, degrees=code_block_17.rDeg)
categories = Categories("OST_GenericModel")
code_block_18 = CodeBlock { "Minute"; }
byGeometry = DirectShape.ByGeometry(geometry=rotate, category=categories, name=code_block_18)

# group: 색상부여
color_palette = ColorPalette({R: 30, G: 144, B: 255, A: 255})
byGeometryColor = Modifiers.GeometryColor.ByGeometryColor(geometry=rotate, color=color_palette)

# group: 시침모듈
code_block_19 = CodeBlock { 1.5*600; }
code_block_20 = CodeBlock { 10*600; }
code_block_21 = CodeBlock(k=code_block_19, j=code_block_20) { Point.ByCoordinates(0, 0, 0); Point.ByCoordinates(k, j, 1*600); }
code_block_22 = CodeBlock(k=code_block_19, i=code_block_21.out0, j=code_block_21.out1) { Cuboid.Translate(t1,-k/2,0,0); t1 = Cuboid.ByCorners(i,j); }
code_block_23 = CodeBlock { Point.ByCoordinates(0,0,0); }
회전축_2 = CodeBlock { Vector.Reverse(Vector.ZAxis()); }
code_block_24 = CodeBlock { 30; 0.5; }
code_block_25 = CodeBlock(i=code_block_10.mkHr, j=code_block_10.mkMin, sc=code_block_24.out0, sc2=code_block_24.out1) { t1 = i; t2 = j; rDeg = (sc * String.ToNumber(t1)) + (sc2 * String.ToNumber(t2)); }
rotate_2 = Geometry.Rotate(geometry=code_block_22.out0, origin=code_block_23, axis=회전축_2, degrees=code_block_25.rDeg)
categories_2 = Categories("OST_GenericModel")
code_block_26 = CodeBlock { "Hour"; }
byGeometry_2 = DirectShape.ByGeometry(geometry=rotate_2, category=categories_2, name=code_block_26)

# group: 색상부여
color_palette_2 = ColorPalette({R: 64, G: 224, B: 208, A: 255})
byGeometryColor_2 = Modifiers.GeometryColor.ByGeometryColor(geometry=rotate_2, color=color_palette_2)

# group: 초침모듈
code_block_27 = CodeBlock { 0.2*600; }
code_block_28 = CodeBlock { 30*600; }
code_block_29 = CodeBlock(k=code_block_27, j=code_block_28) { Point.ByCoordinates(0, 0, 0); Point.ByCoordinates(k, j, 1*100); }
code_block_30 = CodeBlock(k=code_block_27, i=code_block_29.out0, j=code_block_29.out1) { Cuboid.Translate(t1,-k/2,0,0); t1 = Cuboid.ByCorners(i,j); }
code_block_31 = CodeBlock { Point.ByCoordinates(0,0,0); }
회전축_3 = CodeBlock { Vector.Reverse(Vector.ZAxis()); }
code_block_32 = CodeBlock { 6; }
code_block_33 = CodeBlock(i=code_block_10.mkSec, sc=code_block_32) { t1 = i; rDeg = sc * String.ToNumber(t1); }
rotate_3 = Geometry.Rotate(geometry=code_block_30.out0, origin=code_block_31, axis=회전축_3, degrees=code_block_33.rDeg)
categories_3 = Categories("OST_GenericModel")
code_block_34 = CodeBlock { "Second"; }
byGeometry_3 = DirectShape.ByGeometry(geometry=rotate_3, category=categories_3, name=code_block_34)

# group: 색상부여
color_palette_3 = ColorPalette({R: 255, G: 0, B: 255, A: 255})
byGeometryColor_3 = Modifiers.GeometryColor.ByGeometryColor(geometry=rotate_3, color=color_palette_3)

overrideColorInView = Element.OverrideColorInView(element=byGeometry, color=color_palette)
overrideColorInView_2 = Element.OverrideColorInView(element=byGeometry_3, color=color_palette_3)
overrideColorInView_3 = Element.OverrideColorInView(element=byGeometry_2, color=color_palette_2)
