# Dynamo graph Circle.dyn (Dynamo 2.10.1.3976)

byCoordinates = Point.ByCoordinates()
code_block = CodeBlock { 15; }
byCenterPointRadius = Circle.ByCenterPointRadius(centerPoint=byCoordinates, radius=code_block)
byPatch = Surface.ByPatch(closedCurve=byCenterPointRadius)
code_block_2 = CodeBlock { 30; }
code_block_3 = CodeBlock { false; }
thicken = Surface.Thicken(surface=byPatch, thickness=code_block_2, both_sides=code_block_3)
