# Dynamo graph Cuboid 예제.dyn (Dynamo 2.10.1.3976)

number_slider = DoubleSlider(327.1, range=0..600 step 0.1)
number_slider_2 = DoubleSlider(392.5, range=0..600 step 0.1)
number_slider_3 = DoubleSlider(299.3, range=0..600 step 0.1)
byLengths = Cuboid.ByLengths(width=number_slider, length=number_slider_2, height=number_slider_3)
code_block = CodeBlock { "Comments"; "F1"; }
setParameterByName = Element.SetParameterByName(parameterName=code_block.out0, value=code_block.out1)  # unwired: element
byFamilyNameAndTypeName = FamilyType.ByFamilyNameAndTypeName()  # unwired: familyName, typeName
categories = Categories("OST_GenericModel")
code_block_2 = CodeBlock { "test1"; }
byGeometry = DirectShape.ByGeometry(category=categories, name=code_block_2)  # unwired: geometry
