# Dynamo graph Point 예제.dyn (Dynamo 2.10.1.3976)

code_block = CodeBlock { [0,100]; }
code_block_2 = CodeBlock { [0,200]; }
byCoordinates = Point.ByCoordinates(x=code_block, y=code_block_2, lacing=CrossProduct)
