# Dynamo graph Sample1_2021_0726.dyn (Dynamo 2.10.1.3976)

select_model_elements = DSModelElementsSelection()  # 1 picked in the model
code_block = CodeBlock { "Volume"; }
getParameterValueByName = Element.GetParameterValueByName(element=select_model_elements, parameterName=code_block)
