# Dynamo graph 여의봉.dyn (Dynamo 2.10.1.3976)

number_slider = DoubleSlider(0, range=0..100 step 0.1)
number_slider_2 = DoubleSlider(0, range=0..100 step 0.1)
number_slider_3 = DoubleSlider(0, range=0..100 step 0.1)
byCoordinates = Point.ByCoordinates(x=number_slider, y=number_slider_2, z=number_slider_3)
code_block = CodeBlock { 100; }
byCenterPointRadius = Circle.ByCenterPointRadius(centerPoint=byCoordinates, radius=code_block)
code_block_2 = CodeBlock { 300; }
code_block_3 = CodeBlock { 100; }
number_slider_4 = DoubleSlider(4181.6, range=1..5000 step 0.1)
byCoordinates_2 = Point.ByCoordinates(x=number_slider, y=number_slider_2, z=number_slider_4)
number_slider_5 = DoubleSlider(86.2, range=1..100 step 0.1)
byPointsRadius = Cylinder.ByPointsRadius(startPoint=byCoordinates, endPoint=byCoordinates_2, radius=number_slider_5)
categories = Categories("OST_GenericModel")
byGeometry = DirectShape.ByGeometry(geometry=byPointsRadius, category=categories)
getJoinedElements = Element.GetJoinedElements()  # unwired: element
categories_2 = Categories("OST_Windows")
all_elements_of_category = ElementsOfCategory(Category=categories_2)
setParameterByName = Element.SetParameterByName()  # unwired: element, parameterName, value
