# Dynamo custom node CreateConcreteProtectCoatingSurfaceForFDN.dyf (Dynamo 2.10.1.3976)
# category: mQTest
# CreateConcreteProtectCoatingSurface

Element = Input(_Element: var[]..[])
code_block = CodeBlock(Element=Element) { _Element; }
faces = Element.Faces(element=code_block)
faces_2 = Element.Faces()  # unwired: element
code_block_2 = CodeBlock { 0.5; }
normalAtParameter = Surface.NormalAtParameter(u=code_block_2, v=code_block_2)  # unwired: surface
function_compose = ComposeFunctions(function0=faces_2, function1=normalAtParameter)
function_apply = ApplyFunction(function=function_compose, argument0=code_block)
Z = Vector.Z(vector=function_apply)
code_block_3 = CodeBlock(i=Z) { i==-1; }
filterByBoolMask = List.FilterByBoolMask(list=faces, mask=code_block_3)
perimeterCurves = Surface.PerimeterCurves(surface=filterByBoolMask.in)
byJoinedCurves = PolyCurve.ByJoinedCurves(curves=perimeterCurves)
code_block_4 = CodeBlock { _leanOffset: var[]..[] = 100; }
offset = Curve.Offset(curve=byJoinedCurves, distance=code_block_4)
byPatch = Surface.ByPatch(closedCurve=offset)
faces_3 = Element.Faces(element=code_block)
faces_4 = Element.Faces()  # unwired: element
code_block_5 = CodeBlock { 0.5; }
normalAtParameter_2 = Surface.NormalAtParameter(u=code_block_5, v=code_block_5)  # unwired: surface
function_compose_2 = ComposeFunctions(function0=faces_4, function1=normalAtParameter_2)
function_apply_2 = ApplyFunction(function=function_compose_2, argument0=code_block)
Z_2 = Vector.Z(vector=function_apply_2)
code_block_6 = CodeBlock(i=Z_2) { i<1 && i>-1; }
filterByBoolMask_2 = List.FilterByBoolMask(list=faces_3, mask=code_block_6)
join = List.Join(list0=byPatch, list1=filterByBoolMask_2.in)
Surface = Output(join)
color_palette = ColorPalette({R: 30, G: 144, B: 255, A: 129})
byGeometryColor = Modifiers.GeometryColor.ByGeometryColor(geometry=join, color=color_palette)
GeometryColor = Output(byGeometryColor)
