# Dynamo custom node CreateLeanConcrete.dyf (Dynamo 2.10.1.3976)
# category: mQTest
# CreateLeanConcreteForISOFDN

Element = Input(_Element: var[]..[])
code_block = CodeBlock(Element=Element) { _Element; }
faces = Element.Faces(element=code_block)
faces_2 = Element.Faces()  # unwired: element
code_block_2 = CodeBlock { 0.5; }
normalAtParameter = Surface.NormalAtParameter(u=code_block_2, v=code_block_2)  # unwired: surface
function_compose = ComposeFunctions(function0=faces_2, function1=normalAtParameter)
function_apply = ApplyFunction(function=function_compose, argument0=code_block)
Z = Vector.Z(vector=function_apply)
code_block_3 = CodeBlock { 0; }
round = Math.Round(number=Z, digits=code_block_3)
code_block_4 = CodeBlock(i=round) { i==-1; }
filterByBoolMask = List.FilterByBoolMask(list=faces, mask=code_block_4)
perimeterCurves = Surface.PerimeterCurves(surface=filterByBoolMask.in)
byJoinedCurves = PolyCurve.ByJoinedCurves(curves=perimeterCurves)
leanOffset = Input(_leanOffset: var[]..[] = 100)
offset = Curve.Offset(curve=byJoinedCurves, distance=leanOffset)
byPatch = Surface.ByPatch(closedCurve=offset)
leanThick = Input(_leanThick: var[]..[] = 100)
thicken = Surface.Thicken(surface=byPatch, thickness=leanThick)
Solid = Output(thicken)
color_palette = ColorPalette({R: 72, G: 209, B: 204, A: 132})
byGeometryColor = Modifiers.GeometryColor.ByGeometryColor(geometry=thicken, color=color_palette)
GeometryColor = Output(byGeometryColor)
Surface = Output(byPatch)
