# Dynamo custom node ExtractBelowFacesOfElement.dyf (Dynamo 2.10.1.3976)
# category: mQTest
# ExtractBelowFacesOfElement

# note: func2
Element = Input(_Element: var[]..[])
code_block = CodeBlock(Element=Element) { _Element; }
faces = Element.Faces(element=code_block)

# group: func2
faces_2 = Element.Faces()  # unwired: element
code_block_2 = CodeBlock { 0.5; }
normalAtParameter = Surface.NormalAtParameter(u=code_block_2, v=code_block_2)  # unwired: surface
function_compose = ComposeFunctions(function0=faces_2, function1=normalAtParameter)

function_apply = ApplyFunction(function=function_compose, argument0=code_block)
Z = Vector.Z(vector=function_apply)
code_block_3 = CodeBlock(i=Z) { i==-1; }
filterByBoolMask = List.FilterByBoolMask(list=faces, mask=code_block_3)
in_ = Output(filterByBoolMask.in)  # "in"
out = Output(filterByBoolMask.out)
