# Dynamo graph Steel Excel Test2(0727).dyn (Dynamo 2.10.1.3976)

# group: Primary Input
categories = Categories("OST_StructuralFraming")
all_elements_of_category = ElementsOfCategory(Category=categories)
file_path = Filename(".\BIM_물량집계 자동화 산출기준표_rC(20210713)_KCS.xlsx")
file_from_path = FileObject(path=file_path)
code_block = CodeBlock { "Scope_lv2(Str Framing)"; }

getFullWMCodeDescriptionPerElement = Custom[GetFullWMCodeDescriptionPerElement](InputElement=all_elements_of_category, InputFilePath=file_from_path, InputSheetName=code_block)  # GetFullWMCodeDescriptionPerElement
