# Dynamo graph Str Foundation Calculator_DataStructureTest(0724).dyn (Dynamo 2.10.1.3976)

code_block = CodeBlock { "TargetElements"; }
valueAtKey = DesignScript.Builtin.Dictionary.ValueAtKey(key=code_block)  # unwired: dictionary

# group: TargetElementsForFunctionTest
watch = Watch(valueAtKey)  # "Watch@TargetElementsForFunctionTest"

# group: Example
code_block_2 = CodeBlock { ["a","b","c"]; [1,2,3]; }
byKeysValues = DesignScript.Builtin.Dictionary.ByKeysValues(keys=code_block_2.out0, values=code_block_2.out1)
code_block_3 = CodeBlock { ["d","e","f"]; [4,5,6]; }
byKeysValues_2 = DesignScript.Builtin.Dictionary.ByKeysValues(keys=code_block_3.out0, values=code_block_3.out1)
code_block_4 = CodeBlock(a1=byKeysValues, b1=byKeysValues_2)
# ---------- code_block_4.designscript (4 lines) ----------
{
"a1": a1
,"b1": b1
};
# ----------------------------------------
code_block_5 = CodeBlock { "a1"; }
valueAtKey_2 = DesignScript.Builtin.Dictionary.ValueAtKey(dictionary=code_block_4, key=code_block_5)
code_block_6 = CodeBlock { "a"; }
valueAtKey_3 = DesignScript.Builtin.Dictionary.ValueAtKey(dictionary=valueAtKey_2, key=code_block_6)

# group: func0
code_block_7 = CodeBlock { "Volume"; }
getParameterValueByName = Element.GetParameterValueByName(parameterName=code_block_7)  # unwired: element

# group: func1
createExcavationSolid = Custom[CreateExcavationSolid]()  # CreateExcavationSolidForISOFDN; unwired: Element
volume = Solid.Volume()  # unwired: solid
sum = Math.Sum()  # unwired: values
code_block_8 = CodeBlock { 1000000000; }
div = _ / code_block_8  # unwired: x
function_compose = ComposeFunctions(function0=createExcavationSolid.Solid, function1=volume, function2=sum, function3=div)

# group: func2
createBaseCourseSurfaces = Custom[CreateBaseCourseSurfaces]()  # CreateBaseCourseSurfaces; unwired: Element
area = Surface.Area()  # unwired: surface
sum_2 = Math.Sum()  # unwired: values
code_block_9 = CodeBlock { 1000000; }
div_2 = _ / code_block_9  # unwired: x
function_compose_2 = ComposeFunctions(function0=createBaseCourseSurfaces.Surface, function1=area, function2=sum_2, function3=div_2)

# group: func3
createLeanConcrete = Custom[CreateLeanConcrete]()  # CreateLeanConcreteForISOFDN; unwired: Element
volume_2 = Solid.Volume()  # unwired: solid
sum_3 = Math.Sum()  # unwired: values
code_block_10 = CodeBlock { 1000000000; }
div_3 = _ / code_block_10  # unwired: x
function_compose_3 = ComposeFunctions(function0=createLeanConcrete.Solid, function1=volume_2, function2=sum_3, function3=div_3)

# group: func4
extractSideFacesOfElement = Custom[ExtractSideFacesOfElement]()  # ExtractSideFacesOfElement; unwired: Element
area_2 = Surface.Area()  # unwired: surface
sum_4 = Math.Sum()  # unwired: values
code_block_11 = CodeBlock { 1000000; }
div_4 = _ / code_block_11  # unwired: x
function_compose_4 = ComposeFunctions(function0=extractSideFacesOfElement.Surface, function1=area_2, function2=sum_4, function3=div_4)

# group: func5
code_block_12 = CodeBlock { "Volume"; }
getParameterValueByName_2 = Element.GetParameterValueByName(parameterName=code_block_12)  # unwired: element
code_block_13 = CodeBlock { 0.1; }
mul = _ * code_block_13  # unwired: x
function_compose_5 = ComposeFunctions(function0=getParameterValueByName_2, function1=mul)

# group: func6
createConcreteProtectCoatingSurfaceForFD = Custom[CreateConcreteProtectCoatingSurfaceForFDN]()  # CreateConcreteProtectCoatingSurface; unwired: Element
area_3 = Surface.Area()  # unwired: surface
sum_5 = Math.Sum()  # unwired: values
code_block_14 = CodeBlock { 1000000; }
div_5 = _ / code_block_14  # unwired: x
function_compose_6 = ComposeFunctions(function0=createConcreteProtectCoatingSurfaceForFD.Surface, function1=area_3, function2=sum_5, function3=div_5)

extractUpperFacesOfElement = Custom[ExtractUpperFacesOfElement]()  # ExtractUpperFacesOfElement; unwired: Element

# group: func7
area_4 = Surface.Area()  # unwired: surface
sum_6 = Math.Sum()  # unwired: values
code_block_15 = CodeBlock { 1000000; }
div_6 = _ / code_block_15  # unwired: x
function_compose_7 = ComposeFunctions(function0=extractUpperFacesOfElement.Surface, function1=area_4, function2=sum_6, function3=div_6)

join = List.Join(list0=getParameterValueByName, list1=function_compose, list2=function_compose_2, list3=function_compose_3, list4=function_compose_4, list5=function_compose_5, list6=function_compose_6, list7=function_compose_7)

# group: Primary Input
categories = Categories("OST_StructuralFoundation")
all_elements_of_category = ElementsOfCategory(Category=categories)
file_path = Filename(".\BIM_물량집계 자동화 산출기준표_rC(20210722).xlsx")
file_from_path = FileObject(path=file_path)
code_block_16 = CodeBlock { "Scope_lv2(Str Foundations)"; }

getFullWMCodeDescriptionPerElement = Custom[GetFullWMCodeDescriptionPerElement](InputElement=all_elements_of_category, InputFilePath=file_from_path, InputSheetName=code_block_16)  # GetFullWMCodeDescriptionPerElement

# group: Set Up Dictionary <all Element Inform>
# note: Input Node
code_block_17 = CodeBlock(InputDic=getFullWMCodeDescriptionPerElement.Dictionary) { _InputDic; }
code_block_18 = CodeBlock { "AllElement"; }
valueAtKey_4 = DesignScript.Builtin.Dictionary.ValueAtKey(dictionary=code_block_17, key=code_block_18)
name = Element.Name(element=valueAtKey_4)
code_block_19 = CodeBlock { "_"; }
split = String.Split(str=name, separator0=code_block_19)
firstItem = List.FirstItem(list=split@L2)
code_block_20 = CodeBlock { "FullWMCodeDescriptionPerElement"; }
valueAtKey_5 = DesignScript.Builtin.Dictionary.ValueAtKey(dictionary=code_block_17, key=code_block_20)
code_block_21 = CodeBlock(Element=valueAtKey_4, ElementType=name, FamilyCode=firstItem, FullWMCodeDescriptio=valueAtKey_5)
# ---------- code_block_21.designscript (6 lines) ----------
{
"Element": _Element,
"ElementType": _ElementType,
"FamilyCode": _FamilyCode,
"FullWMCodeDescriptionPerElement": _FullWMCodeDescriptionPerElement
};
# ----------------------------------------

# group: Select Target Family + Connect Target WorkMasters per Element and it's Calculated Values
code_block_22 = CodeBlock(InputDic=code_block_21) { _InputDic; }
code_block_23 = CodeBlock { "Element"; }
valueAtKey_6 = DesignScript.Builtin.Dictionary.ValueAtKey(dictionary=code_block_22, key=code_block_23)
code_block_24 = CodeBlock { "FamilyCode"; }
valueAtKey_7 = DesignScript.Builtin.Dictionary.ValueAtKey(dictionary=code_block_22, key=code_block_24)
uniqueItems = List.UniqueItems(list=valueAtKey_7)
targetFamily = CodeBlock(i=uniqueItems) { i[0]; }
contains = String.Contains(str=valueAtKey_7, searchFor=targetFamily@L1)
code_block_25 = CodeBlock { true; }
allIndicesOf = List.AllIndicesOf(list=contains@L2, item=code_block_25)
getItemAtIndex = List.GetItemAtIndex(list=valueAtKey_6, index=allIndicesOf)
name_2 = Element.Name(element=getItemAtIndex)
code_block_26 = CodeBlock { "FullWMCodeDescriptionPerElement"; }
valueAtKey_8 = DesignScript.Builtin.Dictionary.ValueAtKey(dictionary=code_block_22, key=code_block_26)
getItemAtIndex_2 = List.GetItemAtIndex(list=valueAtKey_8, index=allIndicesOf)
code_block_27 = CodeBlock(TargetElements=getItemAtIndex, TargetFamilyIndex=allIndicesOf, TargetFamilyCode=name_2, WMforTargetElements=getItemAtIndex_2)
# ---------- code_block_27.designscript (6 lines) ----------
{
"TargetElements": _TargetElements,
"TargetFamilyIndex": _TargetFamilyIndex,
"TargetFamilyCode": _TargetFamilyCode,
"WMforTargetElements": _WMforTargetElements
};
# ----------------------------------------
code_block_28 = CodeBlock { "TargetElements"; }
valueAtKey_9 = DesignScript.Builtin.Dictionary.ValueAtKey(dictionary=code_block_27, key=code_block_28)
code_block_29 = CodeBlock { "TargetFamilyCode"; }
valueAtKey_10 = DesignScript.Builtin.Dictionary.ValueAtKey(dictionary=code_block_27, key=code_block_29)
code_block_30 = CodeBlock { "WMforTargetElements"; }
valueAtKey_11 = DesignScript.Builtin.Dictionary.ValueAtKey(dictionary=code_block_27, key=code_block_30)
flatten = List.Flatten(list=valueAtKey_11)
uniqueItems_2 = List.UniqueItems(list=flatten)
watch_2 = Watch(uniqueItems_2)
code_block_31 = CodeBlock(TargetElements=valueAtKey_9, TargetFamilyCode=valueAtKey_10, WMforTargetElements=valueAtKey_11, TargetWMunique=watch_2)
# ---------- code_block_31.designscript (6 lines) ----------
{
"TargetElements": _TargetElements,
"TargetFamilyCode": _TargetFamilyCode,
"WMforTargetElements": _WMforTargetElements,
"TargetWMunique": _TargetWMunique
};
# ----------------------------------------

code_block_32 = CodeBlock { "TargetElements"; }
valueAtKey_12 = DesignScript.Builtin.Dictionary.ValueAtKey(dictionary=code_block_31, key=code_block_32)
code_block_33 = CodeBlock { "Volume"; }
# note: <Func>
getParameterValueByName_3 = Element.GetParameterValueByName(element=valueAtKey_12, parameterName=code_block_33)
code_block_34 = CodeBlock(i=getParameterValueByName_3) { List.Flatten(Math.Round(i,2))/1; }
code_block_35 = CodeBlock { "M3"; }
count = List.Count(list=code_block_34)
ofRepeatedItem = List.OfRepeatedItem(item=code_block_35, amount=count)
code_block_36 = CodeBlock(FuncValues=code_block_34, FuncValuesUnit=ofRepeatedItem)
# ---------- code_block_36.designscript (4 lines) ----------
{
"FuncValues": _FuncValues,
"FuncValuesUnit": _FuncValuesUnit
};
# ----------------------------------------
code_block_37 = CodeBlock { "TargetElements"; }
valueAtKey_13 = DesignScript.Builtin.Dictionary.ValueAtKey(dictionary=code_block_31, key=code_block_37)
createExcavationSolid_2 = Custom[CreateExcavationSolid](Element=valueAtKey_13)
volume_3 = Solid.Volume(solid=createExcavationSolid_2.Solid)
code_block_38 = CodeBlock(i=volume_3) { List.Flatten(Math.Round(i,2))/1000000000; }
code_block_39 = CodeBlock { "M3"; }
count_2 = List.Count(list=code_block_38)
ofRepeatedItem_2 = List.OfRepeatedItem(item=code_block_39, amount=count_2)
code_block_40 = CodeBlock(FuncValues=code_block_38, FuncValuesUnit=ofRepeatedItem_2)  # same code as code_block_36
code_block_41 = CodeBlock { "TargetElements"; }
valueAtKey_14 = DesignScript.Builtin.Dictionary.ValueAtKey(dictionary=code_block_31, key=code_block_41)
createBaseCourseSurfaces_2 = Custom[CreateBaseCourseSurfaces](Element=valueAtKey_14)
area_5 = Surface.Area(surface=createBaseCourseSurfaces_2.Surface)
code_block_42 = CodeBlock(i=area_5) { List.Flatten(Math.Round(i,2))/1000000; }
code_block_43 = CodeBlock { "M2"; }
count_3 = List.Count(list=code_block_42)
ofRepeatedItem_3 = List.OfRepeatedItem(item=code_block_43, amount=count_3)
code_block_44 = CodeBlock(FuncValues=code_block_42, FuncValuesUnit=ofRepeatedItem_3)  # same code as code_block_36
code_block_45 = CodeBlock { "TargetElements"; }
valueAtKey_15 = DesignScript.Builtin.Dictionary.ValueAtKey(dictionary=code_block_31, key=code_block_45)
createLeanConcrete_2 = Custom[CreateLeanConcrete](Element=valueAtKey_15)
volume_4 = Solid.Volume(solid=createLeanConcrete_2.Solid)
code_block_46 = CodeBlock(i=volume_4) { List.Flatten(Math.Round(i,2))/1000000000; }
code_block_47 = CodeBlock { "M3"; }
count_4 = List.Count(list=code_block_46)
ofRepeatedItem_4 = List.OfRepeatedItem(item=code_block_47, amount=count_4)
code_block_48 = CodeBlock(FuncValues=code_block_46, FuncValuesUnit=ofRepeatedItem_4)  # same code as code_block_36
code_block_49 = CodeBlock { "TargetElements"; }
valueAtKey_16 = DesignScript.Builtin.Dictionary.ValueAtKey(dictionary=code_block_31, key=code_block_49)
extractSideFacesOfElement_2 = Custom[ExtractSideFacesOfElement](Element=valueAtKey_16)
area_6 = Surface.Area(surface=extractSideFacesOfElement_2.Surface)
sum_7 = Math.Sum(values=area_6)
code_block_50 = CodeBlock(i=sum_7) { List.Flatten(Math.Round(i,2))/1000000; }
code_block_51 = CodeBlock { "M2"; }
count_5 = List.Count(list=code_block_50)
ofRepeatedItem_5 = List.OfRepeatedItem(item=code_block_51, amount=count_5)
code_block_52 = CodeBlock(FuncValues=code_block_50, FuncValuesUnit=ofRepeatedItem_5)  # same code as code_block_36
code_block_53 = CodeBlock { "TargetElements"; }
valueAtKey_17 = DesignScript.Builtin.Dictionary.ValueAtKey(dictionary=code_block_31, key=code_block_53)
code_block_54 = CodeBlock { "Volume"; }
getParameterValueByName_4 = Element.GetParameterValueByName(element=valueAtKey_17, parameterName=code_block_54)
code_block_55 = CodeBlock { 0.1; }
mul_2 = getParameterValueByName_4 * code_block_55
code_block_56 = CodeBlock(i=mul_2) { List.Flatten(Math.Round(i,2))/1; }
code_block_57 = CodeBlock { "TON"; }
count_6 = List.Count(list=code_block_56)
ofRepeatedItem_6 = List.OfRepeatedItem(item=code_block_57, amount=count_6)
code_block_58 = CodeBlock(FuncValues=code_block_56, FuncValuesUnit=ofRepeatedItem_6)  # same code as code_block_36
code_block_59 = CodeBlock { "TargetElements"; }
valueAtKey_18 = DesignScript.Builtin.Dictionary.ValueAtKey(dictionary=code_block_31, key=code_block_59)
createLeanConcrete_3 = Custom[CreateLeanConcrete](Element=valueAtKey_18)
area_7 = Surface.Area(surface=createLeanConcrete_3.Surface)
code_block_60 = CodeBlock(i=area_7) { List.Flatten(Math.Round(i,2))/1000000; }
code_block_61 = CodeBlock { "M2"; }
count_7 = List.Count(list=code_block_60)
ofRepeatedItem_7 = List.OfRepeatedItem(item=code_block_61, amount=count_7)
code_block_62 = CodeBlock(FuncValues=code_block_60, FuncValuesUnit=ofRepeatedItem_7)  # same code as code_block_36
code_block_63 = CodeBlock { "TargetElements"; }
valueAtKey_19 = DesignScript.Builtin.Dictionary.ValueAtKey(dictionary=code_block_31, key=code_block_63)
code_block_64 = CodeBlock(Element=valueAtKey_19) { _Element; }
extractUpperFacesOfElement_2 = Custom[ExtractUpperFacesOfElement](Element=code_block_64)
flatten_2 = List.Flatten(list=extractUpperFacesOfElement_2.Surface)
getJoinedElements = Element.GetJoinedElements(element=code_block_64)
flatten_3 = List.Flatten(list=getJoinedElements)
extractBelowFacesOfElement = Custom[ExtractBelowFacesOfElement](Element=flatten_3)  # ExtractBelowFacesOfElement
flatten_4 = List.Flatten(list=extractBelowFacesOfElement.Surface)
doesIntersect = Geometry.DoesIntersect(geometry=flatten_4, other=flatten_2, lacing=CrossProduct)
code_block_65 = CodeBlock { true; }
allIndicesOf_2 = List.AllIndicesOf(list=doesIntersect@L2, item=code_block_65)
flatten_5 = List.Flatten(list=allIndicesOf_2)
groupByKey = List.GroupByKey(list=flatten_4, keys=flatten_5)
difference = Surface.Difference(surface=flatten_2, others=groupByKey.groups)
extractSideFacesOfElement_3 = Custom[ExtractSideFacesOfElement](Element=code_block_64)
addItemToFront = List.AddItemToFront(item=difference@L1, list=extractSideFacesOfElement_3.Surface@L2)
area_8 = Surface.Area(surface=addItemToFront)
sum_8 = Math.Sum(values=area_8)
code_block_66 = CodeBlock(i=sum_8) { List.Flatten(Math.Round(i,2))/1000000; }
code_block_67 = CodeBlock { "M2"; }
count_8 = List.Count(list=code_block_66)
ofRepeatedItem_8 = List.OfRepeatedItem(item=code_block_67, amount=count_8)
code_block_68 = CodeBlock(FuncValues=code_block_66, FuncValuesUnit=ofRepeatedItem_8)  # same code as code_block_36
join_2 = List.Join(list0=code_block_36, list1=code_block_40, list2=code_block_44, list3=code_block_48, list4=code_block_52, list5=code_block_58, list6=code_block_62, list7=code_block_68)

# group: about <Func Values>
code_block_69 = CodeBlock(InputDic1=code_block_31) { _InputDic1; }
code_block_70 = CodeBlock { "TargetElements"; }
valueAtKey_20 = DesignScript.Builtin.Dictionary.ValueAtKey(dictionary=code_block_69, key=code_block_70)
code_block_71 = CodeBlock { "TargetFamilyCode"; }
valueAtKey_21 = DesignScript.Builtin.Dictionary.ValueAtKey(dictionary=code_block_69, key=code_block_71)
code_block_72 = CodeBlock { "WMforTargetElements"; }
valueAtKey_22 = DesignScript.Builtin.Dictionary.ValueAtKey(dictionary=code_block_69, key=code_block_72)
code_block_73 = CodeBlock(InputDic2=join_2) { _InputDic2; }
code_block_74 = CodeBlock { "FuncValues"; }
valueAtKey_23 = DesignScript.Builtin.Dictionary.ValueAtKey(dictionary=code_block_73, key=code_block_74)
code_block_75 = CodeBlock { "FuncValuesUnit"; }
valueAtKey_24 = DesignScript.Builtin.Dictionary.ValueAtKey(dictionary=code_block_73, key=code_block_75)
code_block_76 = CodeBlock { "TargetWMunique"; }
valueAtKey_25 = DesignScript.Builtin.Dictionary.ValueAtKey(dictionary=code_block_69, key=code_block_76)
watch_3 = Watch(valueAtKey_25)
# note: Select ReferenceWM
code_block_77 = CodeBlock()
# ---------- code_block_77.designscript (3 lines) ----------
[
0,1,2,3,4,5,6,7
];
# ----------------------------------------
getItemAtIndex_3 = List.GetItemAtIndex(list=watch_3, index=code_block_77)
watch_4 = Watch(getItemAtIndex_3)
code_block_78 = CodeBlock(TargetElements=valueAtKey_20, TargetFamilyCode=valueAtKey_21, WMforTargetElements=valueAtKey_22, FuncValues=valueAtKey_23, FuncValuesUnit=valueAtKey_24, ReferenceWM=watch_4)
# ---------- code_block_78.designscript (8 lines) ----------
{
"TargetElements": _TargetElements,
"TargetFamilyCode": _TargetFamilyCode,
"WMforTargetElements": _WMforTargetElements,
"FuncValues": _FuncValues,
"FuncValuesUnit": _FuncValuesUnit,
"ReferenceWM": _ReferenceWM
};
# ----------------------------------------
code_block_79 = CodeBlock(InputDic=code_block_78) { _InputDic; }
code_block_80 = CodeBlock { "TargetElements"; }
valueAtKey_26 = DesignScript.Builtin.Dictionary.ValueAtKey(dictionary=code_block_79, key=code_block_80)
code_block_81 = CodeBlock { "WMforTargetElements"; }
valueAtKey_27 = DesignScript.Builtin.Dictionary.ValueAtKey(dictionary=code_block_79, key=code_block_81)
code_block_82 = CodeBlock { "ReferenceWM"; }
valueAtKey_28 = DesignScript.Builtin.Dictionary.ValueAtKey(dictionary=code_block_79, key=code_block_82)
code_block_83 = CodeBlock { "TargetFamilyCode"; }
valueAtKey_29 = DesignScript.Builtin.Dictionary.ValueAtKey(dictionary=code_block_79, key=code_block_83)
contains_2 = String.Contains(str=valueAtKey_27, searchFor=valueAtKey_28@L1)
code_block_84 = CodeBlock { true; }
allIndicesOf_3 = List.AllIndicesOf(list=contains_2@@L2, item=code_block_84)
code_block_85 = CodeBlock { 1; }
flatten_6 = List.Flatten(list=allIndicesOf_3@L3, amt=code_block_85)
getItemAtIndex_4 = List.GetItemAtIndex(list=valueAtKey_27@L2, index=flatten_6@L3)
code_block_86 = CodeBlock { 1; }
flatten_7 = List.Flatten(list=getItemAtIndex_4@L2, amt=code_block_86)
count_9 = List.Count(list=flatten_7@L3)
ofRepeatedItem_9 = List.OfRepeatedItem(item=valueAtKey_29@L2, amount=count_9@L1)
code_block_87 = CodeBlock { 1; }
flatten_8 = List.Flatten(list=ofRepeatedItem_9@L2, amt=code_block_87)
code_block_88 = CodeBlock { "FuncValues"; }
valueAtKey_30 = DesignScript.Builtin.Dictionary.ValueAtKey(dictionary=code_block_79, key=code_block_88)
code_block_89 = CodeBlock { "FuncValuesUnit"; }
valueAtKey_31 = DesignScript.Builtin.Dictionary.ValueAtKey(dictionary=code_block_79, key=code_block_89)
code_block_90 = CodeBlock(TargetElements=valueAtKey_26, WMforTargetElements=valueAtKey_27, ReferenceWM=valueAtKey_28, TargetFamilyCode=flatten_8, FuncValues=valueAtKey_30, FuncValuesUnit=valueAtKey_31, WMforFuncValues=flatten_7)
# ---------- code_block_90.designscript (9 lines) ----------
{
"TargetElements": _TargetElements,
"WMforTargetElements": _WMforTargetElements,
"ReferenceWM": _ReferenceWM,
"TargetFamilyCode": _TargetFamilyCode,
"FuncValues": _FuncValues,
"FuncValuesUnit": _FuncValuesUnit,
"WMforFuncValues": _WMforFuncValues
};
# ----------------------------------------

code_block_91 = CodeBlock { "WMforFuncValues"; }
valueAtKey_32 = DesignScript.Builtin.Dictionary.ValueAtKey(dictionary=code_block_90, key=code_block_91)
code_block_92 = CodeBlock { "FuncValues"; }
valueAtKey_33 = DesignScript.Builtin.Dictionary.ValueAtKey(dictionary=code_block_90, key=code_block_92)
code_block_93 = CodeBlock { "FuncValuesUnit"; }
valueAtKey_34 = DesignScript.Builtin.Dictionary.ValueAtKey(dictionary=code_block_90, key=code_block_93)
color_palette = ColorPalette({R: 30, G: 144, B: 255, A: 129})
byGeometryColor = Modifiers.GeometryColor.ByGeometryColor(geometry=addItemToFront, color=color_palette)

# group: See Result
code_block_94 = CodeBlock(SeeResult=createBaseCourseSurfaces_2.GeometryColor) { SeeResult; }
code_block_95 = CodeBlock(SeeResult=createExcavationSolid_2.GeometryColor) { SeeResult; }
code_block_96 = CodeBlock(SeeResult=createLeanConcrete_2.GeometryColor) { SeeResult; }
code_block_97 = CodeBlock(SeeResult=extractSideFacesOfElement_2.GeometryColor) { SeeResult; }
code_block_98 = CodeBlock(SeeResult=byGeometryColor) { SeeResult; }

code_block_99 = CodeBlock { "TargetFamilyCode"; }
valueAtKey_35 = DesignScript.Builtin.Dictionary.ValueAtKey(dictionary=code_block_90, key=code_block_99)
