# Dynamo graph Str Foundation Calculator_DataStructureTest(0725).dyn (Dynamo 2.10.1.3976)

# group: Example
code_block = CodeBlock { ["a","b","c"]; [1,2,3]; }
byKeysValues = DesignScript.Builtin.Dictionary.ByKeysValues(keys=code_block.out0, values=code_block.out1)
code_block_2 = CodeBlock { ["d","e","f"]; [4,5,6]; }
byKeysValues_2 = DesignScript.Builtin.Dictionary.ByKeysValues(keys=code_block_2.out0, values=code_block_2.out1)
code_block_3 = CodeBlock(a1=byKeysValues, b1=byKeysValues_2)
# ---------- code_block_3.designscript (4 lines) ----------
{
"a1": a1
,"b1": b1
};
# ----------------------------------------
code_block_4 = CodeBlock { "a1"; }
valueAtKey = DesignScript.Builtin.Dictionary.ValueAtKey(dictionary=code_block_3, key=code_block_4)
code_block_5 = CodeBlock { "a"; }
valueAtKey_2 = DesignScript.Builtin.Dictionary.ValueAtKey(dictionary=valueAtKey, key=code_block_5)

# group: Primary Input
categories = Categories("OST_StructuralFoundation")
all_elements_of_category = ElementsOfCategory(Category=categories)
file_path = Filename(".\BIM_물량집계 자동화 산출기준표_rC(20210722).xlsx")
file_from_path = FileObject(path=file_path)
code_block_6 = CodeBlock { "Scope_lv2(Str Foundations)"; }

getFullWMCodeDescriptionPerElement = Custom[GetFullWMCodeDescriptionPerElement](InputElement=all_elements_of_category, InputFilePath=file_from_path, InputSheetName=code_block_6)  # GetFullWMCodeDescriptionPerElement

# group: Set Up Dictionary <all Element Inform>
# note: Input Node
code_block_7 = CodeBlock(InputDic=getFullWMCodeDescriptionPerElement.Dictionary) { _InputDic; }
code_block_8 = CodeBlock { "AllElement"; }
valueAtKey_3 = DesignScript.Builtin.Dictionary.ValueAtKey(dictionary=code_block_7, key=code_block_8)
name = Element.Name(element=valueAtKey_3)
code_block_9 = CodeBlock { "_"; }
split = String.Split(str=name, separator0=code_block_9)
firstItem = List.FirstItem(list=split@L2)
code_block_10 = CodeBlock { "FullWMCodeDescriptionPerElement"; }
valueAtKey_4 = DesignScript.Builtin.Dictionary.ValueAtKey(dictionary=code_block_7, key=code_block_10)
code_block_11 = CodeBlock(Element=valueAtKey_3, ElementType=name, FamilyCode=firstItem, FullWMCodeDescriptio=valueAtKey_4)
# ---------- code_block_11.designscript (6 lines) ----------
{
"Element": _Element,
"ElementType": _ElementType,
"FamilyCode": _FamilyCode,
"FullWMCodeDescriptionPerElement": _FullWMCodeDescriptionPerElement
};
# ----------------------------------------

# group: Select Target Family + Connect Target WorkMasters per Element and it's Calculated Values
code_block_12 = CodeBlock(InputDic=code_block_11) { _InputDic; }
code_block_13 = CodeBlock { "Element"; }
valueAtKey_5 = DesignScript.Builtin.Dictionary.ValueAtKey(dictionary=code_block_12, key=code_block_13)
code_block_14 = CodeBlock { "FamilyCode"; }
valueAtKey_6 = DesignScript.Builtin.Dictionary.ValueAtKey(dictionary=code_block_12, key=code_block_14)
uniqueItems = List.UniqueItems(list=valueAtKey_6)
watch = Watch(uniqueItems)
targetFamily = CodeBlock(i=watch) { i[0]; }
contains = String.Contains(str=valueAtKey_6, searchFor=targetFamily@L1)
code_block_15 = CodeBlock { true; }
allIndicesOf = List.AllIndicesOf(list=contains@L2, item=code_block_15)
getItemAtIndex = List.GetItemAtIndex(list=valueAtKey_5, index=allIndicesOf)
name_2 = Element.Name(element=getItemAtIndex)
code_block_16 = CodeBlock { "FullWMCodeDescriptionPerElement"; }
valueAtKey_7 = DesignScript.Builtin.Dictionary.ValueAtKey(dictionary=code_block_12, key=code_block_16)
getItemAtIndex_2 = List.GetItemAtIndex(list=valueAtKey_7, index=allIndicesOf)
code_block_17 = CodeBlock(TargetElements=getItemAtIndex, TargetFamilyIndex=allIndicesOf, TargetFamilyCode=name_2, WMforTargetElements=getItemAtIndex_2)
# ---------- code_block_17.designscript (6 lines) ----------
{
"TargetElements": _TargetElements,
"TargetFamilyIndex": _TargetFamilyIndex,
"TargetFamilyCode": _TargetFamilyCode,
"WMforTargetElements": _WMforTargetElements
};
# ----------------------------------------
code_block_18 = CodeBlock { "TargetElements"; }
valueAtKey_8 = DesignScript.Builtin.Dictionary.ValueAtKey(dictionary=code_block_17, key=code_block_18)
code_block_19 = CodeBlock { "TargetFamilyCode"; }
valueAtKey_9 = DesignScript.Builtin.Dictionary.ValueAtKey(dictionary=code_block_17, key=code_block_19)
code_block_20 = CodeBlock { "WMforTargetElements"; }
valueAtKey_10 = DesignScript.Builtin.Dictionary.ValueAtKey(dictionary=code_block_17, key=code_block_20)
flatten = List.Flatten(list=valueAtKey_10)
uniqueItems_2 = List.UniqueItems(list=flatten)
watch_2 = Watch(uniqueItems_2)
code_block_21 = CodeBlock(TargetElements=valueAtKey_8, TargetFamilyCode=valueAtKey_9, WMforTargetElements=valueAtKey_10, TargetWMunique=watch_2)
# ---------- code_block_21.designscript (6 lines) ----------
{
"TargetElements": _TargetElements,
"TargetFamilyCode": _TargetFamilyCode,
"WMforTargetElements": _WMforTargetElements,
"TargetWMunique": _TargetWMunique
};
# ----------------------------------------

code_block_22 = CodeBlock { "TargetElements"; }
valueAtKey_11 = DesignScript.Builtin.Dictionary.ValueAtKey(dictionary=code_block_21, key=code_block_22)
code_block_23 = CodeBlock { "Volume"; }
# note: <Func>
getParameterValueByName = Element.GetParameterValueByName(element=valueAtKey_11, parameterName=code_block_23)
code_block_24 = CodeBlock(i=getParameterValueByName) { Math.Round(List.Flatten(i)/1, 2); }
code_block_25 = CodeBlock { "M3"; }
count = List.Count(list=code_block_24)
ofRepeatedItem = List.OfRepeatedItem(item=code_block_25, amount=count)
code_block_26 = CodeBlock(FuncValues=code_block_24, FuncValuesUnit=ofRepeatedItem)
# ---------- code_block_26.designscript (4 lines) ----------
{
"FuncValues": _FuncValues,
"FuncValuesUnit": _FuncValuesUnit
};
# ----------------------------------------
code_block_27 = CodeBlock { "TargetElements"; }
valueAtKey_12 = DesignScript.Builtin.Dictionary.ValueAtKey(dictionary=code_block_21, key=code_block_27)
createExcavationSolid = Custom[CreateExcavationSolid](Element=valueAtKey_12)  # CreateExcavationSolidForISOFDN
volume = Solid.Volume(solid=createExcavationSolid.Solid)
code_block_28 = CodeBlock(i=volume) { Math.Round(List.Flatten(i)/1000000000, 2); }
code_block_29 = CodeBlock { "M3"; }
count_2 = List.Count(list=code_block_28)
ofRepeatedItem_2 = List.OfRepeatedItem(item=code_block_29, amount=count_2)
code_block_30 = CodeBlock(FuncValues=code_block_28, FuncValuesUnit=ofRepeatedItem_2)  # same code as code_block_26
code_block_31 = CodeBlock { "TargetElements"; }
valueAtKey_13 = DesignScript.Builtin.Dictionary.ValueAtKey(dictionary=code_block_21, key=code_block_31)
createBaseCourseSurfaces = Custom[CreateBaseCourseSurfaces](Element=valueAtKey_13)  # CreateBaseCourseSurfaces
area = Surface.Area(surface=createBaseCourseSurfaces.Surface)
code_block_32 = CodeBlock(i=area) { Math.Round(List.Flatten(i)/1000000, 2); }
code_block_33 = CodeBlock { "M2"; }
count_3 = List.Count(list=code_block_32)
ofRepeatedItem_3 = List.OfRepeatedItem(item=code_block_33, amount=count_3)
code_block_34 = CodeBlock(FuncValues=code_block_32, FuncValuesUnit=ofRepeatedItem_3)  # same code as code_block_26
code_block_35 = CodeBlock { "TargetElements"; }
valueAtKey_14 = DesignScript.Builtin.Dictionary.ValueAtKey(dictionary=code_block_21, key=code_block_35)
createLeanConcrete = Custom[CreateLeanConcrete](Element=valueAtKey_14)  # CreateLeanConcreteForISOFDN
volume_2 = Solid.Volume(solid=createLeanConcrete.Solid)
code_block_36 = CodeBlock(i=volume_2) { Math.Round(List.Flatten(i)/1000000000, 2); }
code_block_37 = CodeBlock { "M3"; }
count_4 = List.Count(list=code_block_36)
ofRepeatedItem_4 = List.OfRepeatedItem(item=code_block_37, amount=count_4)
code_block_38 = CodeBlock(FuncValues=code_block_36, FuncValuesUnit=ofRepeatedItem_4)  # same code as code_block_26
code_block_39 = CodeBlock { "TargetElements"; }
valueAtKey_15 = DesignScript.Builtin.Dictionary.ValueAtKey(dictionary=code_block_21, key=code_block_39)
extractSideFacesOfElement = Custom[ExtractSideFacesOfElement](Element=valueAtKey_15)  # ExtractSideFacesOfElement
area_2 = Surface.Area(surface=extractSideFacesOfElement.Surface)
sum = Math.Sum(values=area_2)
code_block_40 = CodeBlock(i=sum) { Math.Round(List.Flatten(i)/1000000, 2); }
code_block_41 = CodeBlock { "M2"; }
count_5 = List.Count(list=code_block_40)
ofRepeatedItem_5 = List.OfRepeatedItem(item=code_block_41, amount=count_5)
code_block_42 = CodeBlock(FuncValues=code_block_40, FuncValuesUnit=ofRepeatedItem_5)  # same code as code_block_26
code_block_43 = CodeBlock { "TargetElements"; }
valueAtKey_16 = DesignScript.Builtin.Dictionary.ValueAtKey(dictionary=code_block_21, key=code_block_43)
code_block_44 = CodeBlock { "Volume"; }
getParameterValueByName_2 = Element.GetParameterValueByName(element=valueAtKey_16, parameterName=code_block_44)
code_block_45 = CodeBlock { 0.1; }
mul = getParameterValueByName_2 * code_block_45
code_block_46 = CodeBlock(i=mul) { Math.Round(List.Flatten(i)/1, 2); }
code_block_47 = CodeBlock { "TON"; }
count_6 = List.Count(list=code_block_46)
ofRepeatedItem_6 = List.OfRepeatedItem(item=code_block_47, amount=count_6)
code_block_48 = CodeBlock(FuncValues=code_block_46, FuncValuesUnit=ofRepeatedItem_6)  # same code as code_block_26
code_block_49 = CodeBlock { "TargetElements"; }
valueAtKey_17 = DesignScript.Builtin.Dictionary.ValueAtKey(dictionary=code_block_21, key=code_block_49)
createLeanConcrete_2 = Custom[CreateLeanConcrete](Element=valueAtKey_17)
area_3 = Surface.Area(surface=createLeanConcrete_2.Surface)
code_block_50 = CodeBlock(i=area_3) { Math.Round(List.Flatten(i)/1000000, 2); }
code_block_51 = CodeBlock { "M2"; }
count_7 = List.Count(list=code_block_50)
ofRepeatedItem_7 = List.OfRepeatedItem(item=code_block_51, amount=count_7)
code_block_52 = CodeBlock(FuncValues=code_block_50, FuncValuesUnit=ofRepeatedItem_7)  # same code as code_block_26
code_block_53 = CodeBlock { "TargetElements"; }
valueAtKey_18 = DesignScript.Builtin.Dictionary.ValueAtKey(dictionary=code_block_21, key=code_block_53)
code_block_54 = CodeBlock(Element=valueAtKey_18) { _Element; }
extractUpperFacesOfElement = Custom[ExtractUpperFacesOfElement](Element=code_block_54)  # ExtractUpperFacesOfElement
flatten_2 = List.Flatten(list=extractUpperFacesOfElement.Surface)
getJoinedElements = Element.GetJoinedElements(element=code_block_54)
flatten_3 = List.Flatten(list=getJoinedElements)
extractBelowFacesOfElement = Custom[ExtractBelowFacesOfElement](Element=flatten_3)  # ExtractBelowFacesOfElement
flatten_4 = List.Flatten(list=extractBelowFacesOfElement.Surface)
doesIntersect = Geometry.DoesIntersect(geometry=flatten_4, other=flatten_2, lacing=CrossProduct)
code_block_55 = CodeBlock { true; }
allIndicesOf_2 = List.AllIndicesOf(list=doesIntersect@L2, item=code_block_55)
flatten_5 = List.Flatten(list=allIndicesOf_2)
groupByKey = List.GroupByKey(list=flatten_4, keys=flatten_5)
difference = Surface.Difference(surface=flatten_2, others=groupByKey.groups)
extractSideFacesOfElement_2 = Custom[ExtractSideFacesOfElement](Element=code_block_54)
addItemToFront = List.AddItemToFront(item=difference@L1, list=extractSideFacesOfElement_2.Surface@L2)
area_4 = Surface.Area(surface=addItemToFront)
sum_2 = Math.Sum(values=area_4)
code_block_56 = CodeBlock(i=sum_2) { Math.Round(List.Flatten(i)/1000000, 2); }
code_block_57 = CodeBlock { "M2"; }
count_8 = List.Count(list=code_block_56)
ofRepeatedItem_8 = List.OfRepeatedItem(item=code_block_57, amount=count_8)
code_block_58 = CodeBlock(FuncValues=code_block_56, FuncValuesUnit=ofRepeatedItem_8)  # same code as code_block_26
join = List.Join(list0=code_block_26, list1=code_block_30, list2=code_block_34, list3=code_block_38, list4=code_block_42, list5=code_block_48, list6=code_block_52, list7=code_block_58)

# group: about <Func Values>
code_block_59 = CodeBlock(InputDic1=code_block_21) { _InputDic1; }
code_block_60 = CodeBlock { "TargetElements"; }
valueAtKey_19 = DesignScript.Builtin.Dictionary.ValueAtKey(dictionary=code_block_59, key=code_block_60)
code_block_61 = CodeBlock { "TargetFamilyCode"; }
valueAtKey_20 = DesignScript.Builtin.Dictionary.ValueAtKey(dictionary=code_block_59, key=code_block_61)
code_block_62 = CodeBlock { "WMforTargetElements"; }
valueAtKey_21 = DesignScript.Builtin.Dictionary.ValueAtKey(dictionary=code_block_59, key=code_block_62)
code_block_63 = CodeBlock(InputDic2=join) { _InputDic2; }
code_block_64 = CodeBlock { "FuncValues"; }
valueAtKey_22 = DesignScript.Builtin.Dictionary.ValueAtKey(dictionary=code_block_63, key=code_block_64)
code_block_65 = CodeBlock { "FuncValuesUnit"; }
valueAtKey_23 = DesignScript.Builtin.Dictionary.ValueAtKey(dictionary=code_block_63, key=code_block_65)
code_block_66 = CodeBlock { "TargetWMunique"; }
valueAtKey_24 = DesignScript.Builtin.Dictionary.ValueAtKey(dictionary=code_block_59, key=code_block_66)
watch_3 = Watch(valueAtKey_24)
# note: Select ReferenceWM
code_block_67 = CodeBlock()
# ---------- code_block_67.designscript (3 lines) ----------
[
0,1,2,3,4,5,6,7
];
# ----------------------------------------
getItemAtIndex_3 = List.GetItemAtIndex(list=watch_3, index=code_block_67)
watch_4 = Watch(getItemAtIndex_3)
code_block_68 = CodeBlock(TargetElements=valueAtKey_19, TargetFamilyCode=valueAtKey_20, WMforTargetElements=valueAtKey_21, FuncValues=valueAtKey_22, FuncValuesUnit=valueAtKey_23, ReferenceWM=watch_4)
# ---------- code_block_68.designscript (8 lines) ----------
{
"TargetElements": _TargetElements,
"TargetFamilyCode": _TargetFamilyCode,
"WMforTargetElements": _WMforTargetElements,
"FuncValues": _FuncValues,
"FuncValuesUnit": _FuncValuesUnit,
"ReferenceWM": _ReferenceWM
};
# ----------------------------------------
code_block_69 = CodeBlock(InputDic=code_block_68) { _InputDic; }
code_block_70 = CodeBlock { "TargetElements"; }
valueAtKey_25 = DesignScript.Builtin.Dictionary.ValueAtKey(dictionary=code_block_69, key=code_block_70)
code_block_71 = CodeBlock { "WMforTargetElements"; }
valueAtKey_26 = DesignScript.Builtin.Dictionary.ValueAtKey(dictionary=code_block_69, key=code_block_71)
code_block_72 = CodeBlock { "ReferenceWM"; }
valueAtKey_27 = DesignScript.Builtin.Dictionary.ValueAtKey(dictionary=code_block_69, key=code_block_72)
code_block_73 = CodeBlock { "TargetFamilyCode"; }
valueAtKey_28 = DesignScript.Builtin.Dictionary.ValueAtKey(dictionary=code_block_69, key=code_block_73)
contains_2 = String.Contains(str=valueAtKey_26, searchFor=valueAtKey_27@L1)
code_block_74 = CodeBlock { true; }
allIndicesOf_3 = List.AllIndicesOf(list=contains_2@@L2, item=code_block_74)
code_block_75 = CodeBlock { 1; }
flatten_6 = List.Flatten(list=allIndicesOf_3@L3, amt=code_block_75)
getItemAtIndex_4 = List.GetItemAtIndex(list=valueAtKey_26@L2, index=flatten_6@L3)
code_block_76 = CodeBlock { 1; }
flatten_7 = List.Flatten(list=getItemAtIndex_4@L2, amt=code_block_76)
count_9 = List.Count(list=flatten_7@L3)
ofRepeatedItem_9 = List.OfRepeatedItem(item=valueAtKey_28@L2, amount=count_9@L1)
code_block_77 = CodeBlock { 1; }
flatten_8 = List.Flatten(list=ofRepeatedItem_9@L2, amt=code_block_77)
code_block_78 = CodeBlock { "FuncValues"; }
valueAtKey_29 = DesignScript.Builtin.Dictionary.ValueAtKey(dictionary=code_block_69, key=code_block_78)
code_block_79 = CodeBlock { "FuncValuesUnit"; }
valueAtKey_30 = DesignScript.Builtin.Dictionary.ValueAtKey(dictionary=code_block_69, key=code_block_79)
code_block_80 = CodeBlock(TargetElements=valueAtKey_25, WMforTargetElements=valueAtKey_26, ReferenceWM=valueAtKey_27, TargetFamilyCode=flatten_8, FuncValues=valueAtKey_29, FuncValuesUnit=valueAtKey_30, WMforFuncValues=flatten_7)
# ---------- code_block_80.designscript (9 lines) ----------
{
"TargetElements": _TargetElements,
"WMforTargetElements": _WMforTargetElements,
"ReferenceWM": _ReferenceWM,
"TargetFamilyCode": _TargetFamilyCode,
"FuncValues": _FuncValues,
"FuncValuesUnit": _FuncValuesUnit,
"WMforFuncValues": _WMforFuncValues
};
# ----------------------------------------

code_block_81 = CodeBlock { "WMforFuncValues"; }
valueAtKey_31 = DesignScript.Builtin.Dictionary.ValueAtKey(dictionary=code_block_80, key=code_block_81)
code_block_82 = CodeBlock { "FuncValues"; }
valueAtKey_32 = DesignScript.Builtin.Dictionary.ValueAtKey(dictionary=code_block_80, key=code_block_82)
code_block_83 = CodeBlock { "FuncValuesUnit"; }
valueAtKey_33 = DesignScript.Builtin.Dictionary.ValueAtKey(dictionary=code_block_80, key=code_block_83)
color_palette = ColorPalette({R: 30, G: 144, B: 255, A: 129})
byGeometryColor = Modifiers.GeometryColor.ByGeometryColor(geometry=addItemToFront, color=color_palette)

# group: See Result
code_block_84 = CodeBlock(SeeResult=createBaseCourseSurfaces.GeometryColor) { SeeResult; }
code_block_85 = CodeBlock(SeeResult=createExcavationSolid.GeometryColor) { SeeResult; }
code_block_86 = CodeBlock(SeeResult=createLeanConcrete.GeometryColor) { SeeResult; }
code_block_87 = CodeBlock(SeeResult=extractSideFacesOfElement.GeometryColor) { SeeResult; }
code_block_88 = CodeBlock(SeeResult=byGeometryColor) { SeeResult; }

code_block_89 = CodeBlock { "TargetFamilyCode"; }
valueAtKey_34 = DesignScript.Builtin.Dictionary.ValueAtKey(dictionary=code_block_80, key=code_block_89)

# group: Select Target Family + Connect Target WorkMasters per Element and it's Calculated Values
code_block_90 = CodeBlock(InputDic=code_block_11) { _InputDic; }
code_block_91 = CodeBlock { "Element"; }
valueAtKey_35 = DesignScript.Builtin.Dictionary.ValueAtKey(dictionary=code_block_90, key=code_block_91)
code_block_92 = CodeBlock { "FamilyCode"; }
valueAtKey_36 = DesignScript.Builtin.Dictionary.ValueAtKey(dictionary=code_block_90, key=code_block_92)
uniqueItems_3 = List.UniqueItems(list=valueAtKey_36)
watch_5 = Watch(uniqueItems_3)
targetFamily_2 = CodeBlock(i=watch_5) { i[1]; }
contains_3 = String.Contains(str=valueAtKey_36, searchFor=targetFamily_2@L1)
code_block_93 = CodeBlock { true; }
allIndicesOf_4 = List.AllIndicesOf(list=contains_3@L2, item=code_block_93)
getItemAtIndex_5 = List.GetItemAtIndex(list=valueAtKey_35, index=allIndicesOf_4)
name_3 = Element.Name(element=getItemAtIndex_5)
code_block_94 = CodeBlock { "FullWMCodeDescriptionPerElement"; }
valueAtKey_37 = DesignScript.Builtin.Dictionary.ValueAtKey(dictionary=code_block_90, key=code_block_94)
getItemAtIndex_6 = List.GetItemAtIndex(list=valueAtKey_37, index=allIndicesOf_4)
code_block_95 = CodeBlock(TargetElements=getItemAtIndex_5, TargetFamilyIndex=allIndicesOf_4, TargetFamilyCode=name_3, WMforTargetElements=getItemAtIndex_6)  # same code as code_block_17
code_block_96 = CodeBlock { "TargetElements"; }
valueAtKey_38 = DesignScript.Builtin.Dictionary.ValueAtKey(dictionary=code_block_95, key=code_block_96)
code_block_97 = CodeBlock { "TargetFamilyCode"; }
valueAtKey_39 = DesignScript.Builtin.Dictionary.ValueAtKey(dictionary=code_block_95, key=code_block_97)
code_block_98 = CodeBlock { "WMforTargetElements"; }
valueAtKey_40 = DesignScript.Builtin.Dictionary.ValueAtKey(dictionary=code_block_95, key=code_block_98)
flatten_9 = List.Flatten(list=valueAtKey_40)
uniqueItems_4 = List.UniqueItems(list=flatten_9)
watch_6 = Watch(uniqueItems_4)
code_block_99 = CodeBlock(TargetElements=valueAtKey_38, TargetFamilyCode=valueAtKey_39, WMforTargetElements=valueAtKey_40, TargetWMunique=watch_6)  # same code as code_block_21

code_block_100 = CodeBlock { "TargetElements"; }
valueAtKey_41 = DesignScript.Builtin.Dictionary.ValueAtKey(dictionary=code_block_99, key=code_block_100)
extractUpperFacesOfElement_2 = Custom[ExtractUpperFacesOfElement](Element=valueAtKey_41)
area_5 = Surface.Area(surface=extractUpperFacesOfElement_2.Surface)
sum_3 = Math.Sum(values=area_5)
code_block_101 = CodeBlock(i=sum_3) { Math.Round(List.Flatten(i)/1000000, 2); }
code_block_102 = CodeBlock { "M3"; }
count_10 = List.Count(list=code_block_101)
ofRepeatedItem_10 = List.OfRepeatedItem(item=code_block_102, amount=count_10)
code_block_103 = CodeBlock(FuncValues=code_block_101, FuncValuesUnit=ofRepeatedItem_10)  # same code as code_block_26
code_block_104 = CodeBlock { "TargetElements"; }
valueAtKey_42 = DesignScript.Builtin.Dictionary.ValueAtKey(dictionary=code_block_99, key=code_block_104)
code_block_105 = CodeBlock { "Volume"; }
getParameterValueByName_3 = Element.GetParameterValueByName(element=valueAtKey_42, parameterName=code_block_105)
code_block_106 = CodeBlock(i=getParameterValueByName_3) { Math.Round(List.Flatten(i)/1000000, 2); }
code_block_107 = CodeBlock { "M3"; }
count_11 = List.Count(list=code_block_106)
ofRepeatedItem_11 = List.OfRepeatedItem(item=code_block_107, amount=count_11)
code_block_108 = CodeBlock(FuncValues=code_block_106, FuncValuesUnit=ofRepeatedItem_11)  # same code as code_block_26

# group: <Func 2> - 수정필요
code_block_109 = CodeBlock { "TargetElements"; }
valueAtKey_43 = DesignScript.Builtin.Dictionary.ValueAtKey(dictionary=code_block_99, key=code_block_109)
# note: <Func>
extractSideFacesOfElement_3 = Custom[ExtractSideFacesOfElement](Element=valueAtKey_43)
area_6 = Surface.Area(surface=extractSideFacesOfElement_3.Surface)
sum_4 = Math.Sum(values=area_6)
code_block_110 = CodeBlock(i=sum_4) { Math.Round(List.Flatten(i)/1000000, 2); }
code_block_111 = CodeBlock { "M2"; }
count_12 = List.Count(list=code_block_110)
ofRepeatedItem_12 = List.OfRepeatedItem(item=code_block_111, amount=count_12)
code_block_112 = CodeBlock(FuncValues=code_block_110, FuncValuesUnit=ofRepeatedItem_12)  # same code as code_block_26

code_block_113 = CodeBlock { "TargetElements"; }
valueAtKey_44 = DesignScript.Builtin.Dictionary.ValueAtKey(dictionary=code_block_99, key=code_block_113)
createLeanConcrete_3 = Custom[CreateLeanConcrete](Element=valueAtKey_44)
area_7 = Surface.Area(surface=createLeanConcrete_3.Surface)
code_block_114 = CodeBlock(i=area_7) { Math.Round(List.Flatten(i)/1000000, 2); }
code_block_115 = CodeBlock { "M2"; }
count_13 = List.Count(list=code_block_114)
ofRepeatedItem_13 = List.OfRepeatedItem(item=code_block_115, amount=count_13)
code_block_116 = CodeBlock(FuncValues=code_block_114, FuncValuesUnit=ofRepeatedItem_13)  # same code as code_block_26
map = List.Map()  # unwired: list, function
code_block_117 = CodeBlock { "TargetElements"; }
valueAtKey_45 = DesignScript.Builtin.Dictionary.ValueAtKey(dictionary=code_block_99, key=code_block_117)
code_block_118 = CodeBlock { 0; }
createExcavationSolid_2 = Custom[CreateExcavationSolid](Element=valueAtKey_45, ExcavOffsetTop=code_block_118, ExcavOffsetBottom=code_block_118)
isNull = Object.IsNull(object=createExcavationSolid_2.Solid)
code_block_119 = CodeBlock { 1; }
mul_2 = _ * code_block_119  # unwired: x
volume_3 = Solid.Volume()  # unwired: solid
if_ = If(test=isNull, true=mul_2, false=volume_3)
code_block_120 = CodeBlock { 0; }
isNull_2 = Object.IsNull()  # unwired: object
replaceByCondition = Replace(item=createExcavationSolid_2.Solid, replaceWith=code_block_120, condition=isNull_2)
laceShortest = List.LaceShortest(combineFunction=map, list0=if_, list1=replaceByCondition)
code_block_121 = CodeBlock(i=laceShortest) { Math.Round(List.Flatten(i)/1000000000, 2); }
code_block_122 = CodeBlock { "M3"; }
count_14 = List.Count(list=code_block_121)
ofRepeatedItem_14 = List.OfRepeatedItem(item=code_block_122, amount=count_14)
code_block_123 = CodeBlock(FuncValues=code_block_121, FuncValuesUnit=ofRepeatedItem_14)  # same code as code_block_26
code_block_124 = CodeBlock { 0; }
code_block_125 = CodeBlock { "TargetElements"; }
valueAtKey_46 = DesignScript.Builtin.Dictionary.ValueAtKey(dictionary=code_block_99, key=code_block_125)
count_15 = List.Count(list=valueAtKey_46@L1)
ofRepeatedItem_15 = List.OfRepeatedItem(item=code_block_124, amount=count_15)
code_block_126 = CodeBlock(i=ofRepeatedItem_15) { Math.Round(List.Flatten(i)/1000000000, 2); }
code_block_127 = CodeBlock { "M3"; }
count_16 = List.Count(list=code_block_126)
ofRepeatedItem_16 = List.OfRepeatedItem(item=code_block_127, amount=count_16)
code_block_128 = CodeBlock(FuncValues=code_block_126, FuncValuesUnit=ofRepeatedItem_16)  # same code as code_block_26
code_block_129 = CodeBlock { 0; }
code_block_130 = CodeBlock { "TargetElements"; }
valueAtKey_47 = DesignScript.Builtin.Dictionary.ValueAtKey(dictionary=code_block_99, key=code_block_130)
count_17 = List.Count(list=valueAtKey_47@L1)
ofRepeatedItem_17 = List.OfRepeatedItem(item=code_block_129, amount=count_17)
code_block_131 = CodeBlock(i=ofRepeatedItem_17) { Math.Round(List.Flatten(i)/1000000000, 2); }
code_block_132 = CodeBlock { "M3"; }
count_18 = List.Count(list=code_block_131)
ofRepeatedItem_18 = List.OfRepeatedItem(item=code_block_132, amount=count_18)
code_block_133 = CodeBlock(FuncValues=code_block_131, FuncValuesUnit=ofRepeatedItem_18)  # same code as code_block_26
code_block_134 = CodeBlock { "TargetElements"; }
valueAtKey_48 = DesignScript.Builtin.Dictionary.ValueAtKey(dictionary=code_block_99, key=code_block_134)
createBaseCourseSurfaces_2 = Custom[CreateBaseCourseSurfaces](Element=valueAtKey_48)
area_8 = Surface.Area(surface=createBaseCourseSurfaces_2.Surface)
code_block_135 = CodeBlock(i=area_8) { Math.Round(List.Flatten(i)/1000000, 2); }
code_block_136 = CodeBlock { "M2"; }
count_19 = List.Count(list=code_block_135)
ofRepeatedItem_19 = List.OfRepeatedItem(item=code_block_136, amount=count_19)
code_block_137 = CodeBlock(FuncValues=code_block_135, FuncValuesUnit=ofRepeatedItem_19)  # same code as code_block_26
code_block_138 = CodeBlock { 0; }
code_block_139 = CodeBlock { "TargetElements"; }
valueAtKey_49 = DesignScript.Builtin.Dictionary.ValueAtKey(dictionary=code_block_99, key=code_block_139)
count_20 = List.Count(list=valueAtKey_49@L1)
ofRepeatedItem_20 = List.OfRepeatedItem(item=code_block_138, amount=count_20)
code_block_140 = CodeBlock(i=ofRepeatedItem_20) { Math.Round(List.Flatten(i)/1000000000, 2); }
code_block_141 = CodeBlock { "M3"; }
count_21 = List.Count(list=code_block_140)
ofRepeatedItem_21 = List.OfRepeatedItem(item=code_block_141, amount=count_21)
code_block_142 = CodeBlock(FuncValues=code_block_140, FuncValuesUnit=ofRepeatedItem_21)  # same code as code_block_26
code_block_143 = CodeBlock { "TargetElements"; }
valueAtKey_50 = DesignScript.Builtin.Dictionary.ValueAtKey(dictionary=code_block_99, key=code_block_143)
code_block_144 = CodeBlock { 0; 100; }
createLeanConcrete_4 = Custom[CreateLeanConcrete](Element=valueAtKey_50, leanOffset=code_block_144.out0, leanThick=code_block_144.out1)
volume_4 = Solid.Volume(solid=createLeanConcrete_4.Solid)
code_block_145 = CodeBlock(i=volume_4) { Math.Round(List.Flatten(i)/1000000000, 2); }
code_block_146 = CodeBlock { "M3"; }
count_22 = List.Count(list=code_block_145)
ofRepeatedItem_22 = List.OfRepeatedItem(item=code_block_146, amount=count_22)
code_block_147 = CodeBlock(FuncValues=code_block_145, FuncValuesUnit=ofRepeatedItem_22)  # same code as code_block_26
code_block_148 = CodeBlock { "TargetElements"; }
valueAtKey_51 = DesignScript.Builtin.Dictionary.ValueAtKey(dictionary=code_block_99, key=code_block_148)
code_block_149 = CodeBlock { "Volume"; }
getParameterValueByName_4 = Element.GetParameterValueByName(element=valueAtKey_51, parameterName=code_block_149)
code_block_150 = CodeBlock { 0.1; }
mul_3 = getParameterValueByName_4 * code_block_150
code_block_151 = CodeBlock(i=mul_3) { Math.Round(List.Flatten(i)/1, 2); }
code_block_152 = CodeBlock { "TON"; }
count_23 = List.Count(list=code_block_151)
ofRepeatedItem_23 = List.OfRepeatedItem(item=code_block_152, amount=count_23)
code_block_153 = CodeBlock(FuncValues=code_block_151, FuncValuesUnit=ofRepeatedItem_23)  # same code as code_block_26
join_2 = List.Join(list0=code_block_103, list1=code_block_108, list2=code_block_112, list3=code_block_116, list4=code_block_123, list5=code_block_128, list6=code_block_133, list7=code_block_137, list8=code_block_142, list9=code_block_147, list10=code_block_153)

# group: about <Func Values>
code_block_154 = CodeBlock(InputDic1=code_block_99) { _InputDic1; }
code_block_155 = CodeBlock { "TargetElements"; }
valueAtKey_52 = DesignScript.Builtin.Dictionary.ValueAtKey(dictionary=code_block_154, key=code_block_155)
code_block_156 = CodeBlock { "TargetFamilyCode"; }
valueAtKey_53 = DesignScript.Builtin.Dictionary.ValueAtKey(dictionary=code_block_154, key=code_block_156)
code_block_157 = CodeBlock { "WMforTargetElements"; }
valueAtKey_54 = DesignScript.Builtin.Dictionary.ValueAtKey(dictionary=code_block_154, key=code_block_157)
code_block_158 = CodeBlock(InputDic2=join_2) { _InputDic2; }
code_block_159 = CodeBlock { "FuncValues"; }
valueAtKey_55 = DesignScript.Builtin.Dictionary.ValueAtKey(dictionary=code_block_158, key=code_block_159)
code_block_160 = CodeBlock { "FuncValuesUnit"; }
valueAtKey_56 = DesignScript.Builtin.Dictionary.ValueAtKey(dictionary=code_block_158, key=code_block_160)
code_block_161 = CodeBlock { "TargetWMunique"; }
valueAtKey_57 = DesignScript.Builtin.Dictionary.ValueAtKey(dictionary=code_block_154, key=code_block_161)
watch_7 = Watch(valueAtKey_57)
# note: Select ReferenceWM
code_block_162 = CodeBlock()
# ---------- code_block_162.designscript (3 lines) ----------
[
0,1,2,3,4,5,6,7,8,9,10
];
# ----------------------------------------
getItemAtIndex_7 = List.GetItemAtIndex(list=watch_7, index=code_block_162)
watch_8 = Watch(getItemAtIndex_7)
code_block_163 = CodeBlock(TargetElements=valueAtKey_52, TargetFamilyCode=valueAtKey_53, WMforTargetElements=valueAtKey_54, FuncValues=valueAtKey_55, FuncValuesUnit=valueAtKey_56, ReferenceWM=watch_8)  # same code as code_block_68
code_block_164 = CodeBlock(InputDic=code_block_163) { _InputDic; }
code_block_165 = CodeBlock { "TargetElements"; }
valueAtKey_58 = DesignScript.Builtin.Dictionary.ValueAtKey(dictionary=code_block_164, key=code_block_165)
code_block_166 = CodeBlock { "WMforTargetElements"; }
valueAtKey_59 = DesignScript.Builtin.Dictionary.ValueAtKey(dictionary=code_block_164, key=code_block_166)
code_block_167 = CodeBlock { "ReferenceWM"; }
valueAtKey_60 = DesignScript.Builtin.Dictionary.ValueAtKey(dictionary=code_block_164, key=code_block_167)
code_block_168 = CodeBlock { "TargetFamilyCode"; }
valueAtKey_61 = DesignScript.Builtin.Dictionary.ValueAtKey(dictionary=code_block_164, key=code_block_168)
contains_4 = String.Contains(str=valueAtKey_59, searchFor=valueAtKey_60@L1)
code_block_169 = CodeBlock { true; }
allIndicesOf_5 = List.AllIndicesOf(list=contains_4@@L2, item=code_block_169)
code_block_170 = CodeBlock { 1; }
flatten_10 = List.Flatten(list=allIndicesOf_5@L3, amt=code_block_170)
getItemAtIndex_8 = List.GetItemAtIndex(list=valueAtKey_59@L2, index=flatten_10@L3)
code_block_171 = CodeBlock { 1; }
flatten_11 = List.Flatten(list=getItemAtIndex_8@L2, amt=code_block_171)
count_24 = List.Count(list=flatten_11@L3)
ofRepeatedItem_24 = List.OfRepeatedItem(item=valueAtKey_61@L2, amount=count_24@L1)
code_block_172 = CodeBlock { 1; }
flatten_12 = List.Flatten(list=ofRepeatedItem_24@L2, amt=code_block_172)
code_block_173 = CodeBlock { "FuncValues"; }
valueAtKey_62 = DesignScript.Builtin.Dictionary.ValueAtKey(dictionary=code_block_164, key=code_block_173)
code_block_174 = CodeBlock { "FuncValuesUnit"; }
valueAtKey_63 = DesignScript.Builtin.Dictionary.ValueAtKey(dictionary=code_block_164, key=code_block_174)
code_block_175 = CodeBlock(TargetElements=valueAtKey_58, WMforTargetElements=valueAtKey_59, ReferenceWM=valueAtKey_60, TargetFamilyCode=flatten_12, FuncValues=valueAtKey_62, FuncValuesUnit=valueAtKey_63, WMforFuncValues=flatten_11)  # same code as code_block_80

code_block_176 = CodeBlock { "WMforFuncValues"; }
valueAtKey_64 = DesignScript.Builtin.Dictionary.ValueAtKey(dictionary=code_block_175, key=code_block_176)
code_block_177 = CodeBlock { "FuncValues"; }
valueAtKey_65 = DesignScript.Builtin.Dictionary.ValueAtKey(dictionary=code_block_175, key=code_block_177)
code_block_178 = CodeBlock { "FuncValuesUnit"; }
valueAtKey_66 = DesignScript.Builtin.Dictionary.ValueAtKey(dictionary=code_block_175, key=code_block_178)
code_block_179 = CodeBlock { "TargetFamilyCode"; }
valueAtKey_67 = DesignScript.Builtin.Dictionary.ValueAtKey(dictionary=code_block_175, key=code_block_179)

# group: See Result
code_block_180 = CodeBlock(SeeResult=extractUpperFacesOfElement_2.GeometryColor) { SeeResult; }
code_block_181 = CodeBlock(SeeResult=extractSideFacesOfElement_3.GeometryColor) { SeeResult; }
code_block_182 = CodeBlock(SeeResult=createLeanConcrete_4.GeometryColor) { SeeResult; }
code_block_183 = CodeBlock(SeeResult=createExcavationSolid_2.GeometryColor) { SeeResult; }
code_block_184 = CodeBlock(SeeResult=createBaseCourseSurfaces_2.GeometryColor) { SeeResult; }
