# Dynamo graph Str Foundation Calculator_DataStructureTest(0726).dyn (Dynamo 2.10.1.3976)

# group: Example
code_block = CodeBlock { ["a","b","c"]; [1,2,3]; }
byKeysValues = DesignScript.Builtin.Dictionary.ByKeysValues(keys=code_block.out0, values=code_block.out1)
code_block_2 = CodeBlock { ["d","e","f"]; [4,5,6]; }
byKeysValues_2 = DesignScript.Builtin.Dictionary.ByKeysValues(keys=code_block_2.out0, values=code_block_2.out1)
code_block_3 = CodeBlock(a1=byKeysValues, b1=byKeysValues_2)
# ---------- code_block_3.designscript (4 lines) ----------
{
"a1": a1
,"b1": b1
};
# ----------------------------------------
code_block_4 = CodeBlock { "a1"; }
valueAtKey = DesignScript.Builtin.Dictionary.ValueAtKey(dictionary=code_block_3, key=code_block_4)
code_block_5 = CodeBlock { "a"; }
valueAtKey_2 = DesignScript.Builtin.Dictionary.ValueAtKey(dictionary=valueAtKey, key=code_block_5)

# group: Primary Input
categories = Categories("OST_StructuralFoundation")
all_elements_of_category = ElementsOfCategory(Category=categories)
file_path = Filename(".\BIM_물량집계 자동화 산출기준표_rC(20210726).xlsx")
file_from_path = FileObject(path=file_path)
code_block_6 = CodeBlock { "Scope_lv2(Str Foundations)"; }

getFullWMCodeDescriptionPerElement = Custom[GetFullWMCodeDescriptionPerElement](InputElement=all_elements_of_category, InputFilePath=file_from_path, InputSheetName=code_block_6)  # GetFullWMCodeDescriptionPerElement
organizeAllElementInformAsDictionary = Custom[OrganizeAllElementInformAsDictionary](InputDic=getFullWMCodeDescriptionPerElement.Dictionary)  # OrganizeAllElementInformAsDictionary

# group: Select Target Family Element And Connected WorkMasters
code_block_7 = CodeBlock { 0; }
selectTargetFamilyInformAsDictionary = Custom[SelectTargetFamilyInformAsDictionary](InputDic=organizeAllElementInformAsDictionary, InputIndex=code_block_7)  # Select Target Family Element And Connected WorkMasters

# group: Distributer
code_block_8 = CodeBlock(i=selectTargetFamilyInformAsDictionary) { i; }
code_block_9 = CodeBlock(i=code_block_8) { i; }
code_block_10 = CodeBlock(i=code_block_9) { i; }
code_block_11 = CodeBlock(i=code_block_9) { i; }
code_block_12 = CodeBlock(i=code_block_9) { i; }
code_block_13 = CodeBlock(i=code_block_8) { i; }
code_block_14 = CodeBlock(i=code_block_13) { i; }
code_block_15 = CodeBlock(i=code_block_13) { i; }
code_block_16 = CodeBlock(i=code_block_9) { i; }
code_block_17 = CodeBlock(i=code_block_13) { i; }
code_block_18 = CodeBlock(i=code_block_13) { i; }

code_block_19 = CodeBlock { "TargetElements"; }
valueAtKey_3 = DesignScript.Builtin.Dictionary.ValueAtKey(dictionary=code_block_10, key=code_block_19)
# note: <Func>
createBaseCourseSurfaces = Custom[CreateBaseCourseSurfaces](Element=valueAtKey_3)  # CreateBaseCourseSurfaces
code_block_20 = CodeBlock { "TargetElements"; }
valueAtKey_4 = DesignScript.Builtin.Dictionary.ValueAtKey(dictionary=code_block_11, key=code_block_20)
createExcavationSolid = Custom[CreateExcavationSolid](Element=valueAtKey_4)  # CreateExcavationSolidForISOFDN
code_block_21 = CodeBlock { "TargetElements"; }
valueAtKey_5 = DesignScript.Builtin.Dictionary.ValueAtKey(dictionary=code_block_12, key=code_block_21)
createLeanConcrete = Custom[CreateLeanConcrete](Element=valueAtKey_5)  # CreateLeanConcreteForISOFDN
code_block_22 = CodeBlock { "TargetElements"; }
valueAtKey_6 = DesignScript.Builtin.Dictionary.ValueAtKey(dictionary=code_block_14, key=code_block_22)
extractSideFacesOfElement = Custom[ExtractSideFacesOfElement](Element=valueAtKey_6)  # ExtractSideFacesOfElement
code_block_23 = CodeBlock { "TargetElements"; }
valueAtKey_7 = DesignScript.Builtin.Dictionary.ValueAtKey(dictionary=code_block_15, key=code_block_23)
code_block_24 = CodeBlock(Element=valueAtKey_7) { _Element; }
extractUpperFacesOfElement = Custom[ExtractUpperFacesOfElement](Element=code_block_24)  # ExtractUpperFacesOfElement
flatten = List.Flatten(list=extractUpperFacesOfElement.Surface)
getJoinedElements = Element.GetJoinedElements(element=code_block_24)
flatten_2 = List.Flatten(list=getJoinedElements)
extractBelowFacesOfElement = Custom[ExtractBelowFacesOfElement](Element=flatten_2)  # ExtractBelowFacesOfElement
flatten_3 = List.Flatten(list=extractBelowFacesOfElement.Surface)
doesIntersect = Geometry.DoesIntersect(geometry=flatten_3, other=flatten, lacing=CrossProduct)
code_block_25 = CodeBlock { true; }
allIndicesOf = List.AllIndicesOf(list=doesIntersect@L2, item=code_block_25)
flatten_4 = List.Flatten(list=allIndicesOf)
groupByKey = List.GroupByKey(list=flatten_3, keys=flatten_4)
difference = Surface.Difference(surface=flatten, others=groupByKey.groups)
extractSideFacesOfElement_2 = Custom[ExtractSideFacesOfElement](Element=code_block_24)
addItemToFront = List.AddItemToFront(item=difference@L1, list=extractSideFacesOfElement_2.Surface@L2)
color_palette = ColorPalette({R: 30, G: 144, B: 255, A: 129})
byGeometryColor = Modifiers.GeometryColor.ByGeometryColor(geometry=addItemToFront, color=color_palette)

# group: See Result
code_block_26 = CodeBlock(SeeResult=createBaseCourseSurfaces.GeometryColor) { SeeResult; }
code_block_27 = CodeBlock(SeeResult=createExcavationSolid.GeometryColor) { SeeResult; }
code_block_28 = CodeBlock(SeeResult=createLeanConcrete.GeometryColor) { SeeResult; }
code_block_29 = CodeBlock(SeeResult=extractSideFacesOfElement.GeometryColor) { SeeResult; }
code_block_30 = CodeBlock(SeeResult=byGeometryColor) { SeeResult; }

# group: Select Target Family Element And Connected WorkMasters
code_block_31 = CodeBlock { 1; }
selectTargetFamilyInformAsDictionary_2 = Custom[SelectTargetFamilyInformAsDictionary](InputDic=organizeAllElementInformAsDictionary, InputIndex=code_block_31)

# group: Distributer
code_block_32 = CodeBlock(i=selectTargetFamilyInformAsDictionary_2) { i; }
code_block_33 = CodeBlock(i=code_block_32) { i; }
code_block_34 = CodeBlock(i=code_block_33) { i; }
code_block_35 = CodeBlock(i=code_block_33) { i; }
code_block_36 = CodeBlock(i=code_block_32) { i; }
code_block_37 = CodeBlock(i=code_block_36) { i; }
code_block_38 = CodeBlock(i=code_block_32) { i; }
code_block_39 = CodeBlock(i=code_block_38) { i; }
code_block_40 = CodeBlock(i=code_block_32) { i; }
code_block_41 = CodeBlock(i=code_block_40) { i; }
code_block_42 = CodeBlock(i=code_block_33) { i; }
code_block_43 = CodeBlock(i=code_block_38) { i; }
code_block_44 = CodeBlock(i=code_block_38) { i; }
code_block_45 = CodeBlock(i=code_block_40) { i; }
code_block_46 = CodeBlock(i=code_block_40) { i; }
code_block_47 = CodeBlock(i=code_block_36) { i; }

code_block_48 = CodeBlock { "TargetElements"; }
valueAtKey_8 = DesignScript.Builtin.Dictionary.ValueAtKey(dictionary=code_block_34, key=code_block_48)
extractUpperFacesOfElement_2 = Custom[ExtractUpperFacesOfElement](Element=valueAtKey_8)

# group: <Func 2> - 수정필요
code_block_49 = CodeBlock { "TargetElements"; }
valueAtKey_9 = DesignScript.Builtin.Dictionary.ValueAtKey(dictionary=code_block_35, key=code_block_49)
# note: <Func>
extractSideFacesOfElement_3 = Custom[ExtractSideFacesOfElement](Element=valueAtKey_9)
area = Surface.Area(surface=extractSideFacesOfElement_3.Surface)
sum = Math.Sum(values=area)
code_block_50 = CodeBlock(i=sum) { Math.Round(List.Flatten(i)/1000000, 2); }
code_block_51 = CodeBlock { "M2"; }
count = List.Count(list=code_block_50)
ofRepeatedItem = List.OfRepeatedItem(item=code_block_51, amount=count)
code_block_52 = CodeBlock(FuncValues=code_block_50, FuncValuesUnit=ofRepeatedItem)
# ---------- code_block_52.designscript (4 lines) ----------
{
"FuncValues": _FuncValues,
"FuncValuesUnit": _FuncValuesUnit
};
# ----------------------------------------

code_block_53 = CodeBlock { "TargetElements"; }
valueAtKey_10 = DesignScript.Builtin.Dictionary.ValueAtKey(dictionary=code_block_37, key=code_block_53)
code_block_54 = CodeBlock { 0; 100; }
createLeanConcrete_2 = Custom[CreateLeanConcrete](Element=valueAtKey_10, leanOffset=code_block_54.out0, leanThick=code_block_54.out1)
code_block_55 = CodeBlock { "TargetElements"; }
valueAtKey_11 = DesignScript.Builtin.Dictionary.ValueAtKey(dictionary=code_block_39, key=code_block_55)
code_block_56 = CodeBlock { 0; }
createExcavationSolid_2 = Custom[CreateExcavationSolid](Element=valueAtKey_11, ExcavOffsetTop=code_block_56, ExcavOffsetBottom=code_block_56)
code_block_57 = CodeBlock { "TargetElements"; }
valueAtKey_12 = DesignScript.Builtin.Dictionary.ValueAtKey(dictionary=code_block_41, key=code_block_57)
createBaseCourseSurfaces_2 = Custom[CreateBaseCourseSurfaces](Element=valueAtKey_12)

# group: See Result
code_block_58 = CodeBlock(SeeResult=extractUpperFacesOfElement_2.GeometryColor) { SeeResult; }
code_block_59 = CodeBlock(SeeResult=extractSideFacesOfElement_3.GeometryColor) { SeeResult; }
code_block_60 = CodeBlock(SeeResult=createLeanConcrete_2.GeometryColor) { SeeResult; }
code_block_61 = CodeBlock(SeeResult=createExcavationSolid_2.GeometryColor) { SeeResult; }
code_block_62 = CodeBlock(SeeResult=createBaseCourseSurfaces_2.GeometryColor) { SeeResult; }

# group: TargetWMunique
code_block_63 = CodeBlock(InputDic1=code_block_8) { _InputDic1; }
code_block_64 = CodeBlock { "TargetWMunique"; }
valueAtKey_13 = DesignScript.Builtin.Dictionary.ValueAtKey(dictionary=code_block_63, key=code_block_64)
watch = Watch(valueAtKey_13)

# group: TargetWMunique
code_block_65 = CodeBlock(InputDic1=code_block_32) { _InputDic1; }
code_block_66 = CodeBlock { "TargetWMunique"; }
valueAtKey_14 = DesignScript.Builtin.Dictionary.ValueAtKey(dictionary=code_block_65, key=code_block_66)
watch_2 = Watch(valueAtKey_14)

# group: Select Target Family Element And Connected WorkMasters
code_block_67 = CodeBlock { 2; }
selectTargetFamilyInformAsDictionary_3 = Custom[SelectTargetFamilyInformAsDictionary](InputDic=organizeAllElementInformAsDictionary, InputIndex=code_block_67)

# group: Distributer
code_block_68 = CodeBlock(i=selectTargetFamilyInformAsDictionary_3) { i; }
code_block_69 = CodeBlock(i=code_block_68) { i; }
code_block_70 = CodeBlock(i=code_block_69) { i; }
code_block_71 = CodeBlock(i=code_block_69) { i; }
code_block_72 = CodeBlock(i=code_block_68) { i; }
code_block_73 = CodeBlock(i=code_block_72) { i; }
code_block_74 = CodeBlock(i=code_block_68) { i; }
code_block_75 = CodeBlock(i=code_block_74) { i; }
code_block_76 = CodeBlock(i=code_block_68) { i; }
code_block_77 = CodeBlock(i=code_block_76) { i; }
code_block_78 = CodeBlock(i=code_block_69) { i; }
code_block_79 = CodeBlock(i=code_block_74) { i; }
code_block_80 = CodeBlock(i=code_block_74) { i; }
code_block_81 = CodeBlock(i=code_block_76) { i; }
code_block_82 = CodeBlock(i=code_block_76) { i; }
code_block_83 = CodeBlock(i=code_block_72) { i; }

code_block_84 = CodeBlock { "TargetElements"; }
valueAtKey_15 = DesignScript.Builtin.Dictionary.ValueAtKey(dictionary=code_block_70, key=code_block_84)
extractUpperFacesOfElement_3 = Custom[ExtractUpperFacesOfElement](Element=valueAtKey_15)

# group: <Func 2> - 수정필요
code_block_85 = CodeBlock { "TargetElements"; }
valueAtKey_16 = DesignScript.Builtin.Dictionary.ValueAtKey(dictionary=code_block_71, key=code_block_85)
# note: <Func>
extractSideFacesOfElement_4 = Custom[ExtractSideFacesOfElement](Element=valueAtKey_16)
area_2 = Surface.Area(surface=extractSideFacesOfElement_4.Surface)
sum_2 = Math.Sum(values=area_2)
code_block_86 = CodeBlock(i=sum_2) { Math.Round(List.Flatten(i)/1000000, 2); }
code_block_87 = CodeBlock { "M2"; }
count_2 = List.Count(list=code_block_86)
ofRepeatedItem_2 = List.OfRepeatedItem(item=code_block_87, amount=count_2)
code_block_88 = CodeBlock(FuncValues=code_block_86, FuncValuesUnit=ofRepeatedItem_2)  # same code as code_block_52

code_block_89 = CodeBlock { "TargetElements"; }
valueAtKey_17 = DesignScript.Builtin.Dictionary.ValueAtKey(dictionary=code_block_73, key=code_block_89)
code_block_90 = CodeBlock { 0; 100; }
createLeanConcrete_3 = Custom[CreateLeanConcrete](Element=valueAtKey_17, leanOffset=code_block_90.out0, leanThick=code_block_90.out1)
code_block_91 = CodeBlock { "TargetElements"; }
valueAtKey_18 = DesignScript.Builtin.Dictionary.ValueAtKey(dictionary=code_block_75, key=code_block_91)
code_block_92 = CodeBlock { 0; }
createExcavationSolid_3 = Custom[CreateExcavationSolid](Element=valueAtKey_18, ExcavOffsetTop=code_block_92, ExcavOffsetBottom=code_block_92)
code_block_93 = CodeBlock { "TargetElements"; }
valueAtKey_19 = DesignScript.Builtin.Dictionary.ValueAtKey(dictionary=code_block_77, key=code_block_93)
createBaseCourseSurfaces_3 = Custom[CreateBaseCourseSurfaces](Element=valueAtKey_19)

# group: See Result
code_block_94 = CodeBlock(SeeResult=extractUpperFacesOfElement_3.GeometryColor) { SeeResult; }
code_block_95 = CodeBlock(SeeResult=extractSideFacesOfElement_4.GeometryColor) { SeeResult; }
code_block_96 = CodeBlock(SeeResult=createLeanConcrete_3.GeometryColor) { SeeResult; }
code_block_97 = CodeBlock(SeeResult=createExcavationSolid_3.GeometryColor) { SeeResult; }
code_block_98 = CodeBlock(SeeResult=createBaseCourseSurfaces_3.GeometryColor) { SeeResult; }

# group: TargetWMunique
code_block_99 = CodeBlock(InputDic1=code_block_68) { _InputDic1; }
code_block_100 = CodeBlock { "TargetWMunique"; }
valueAtKey_20 = DesignScript.Builtin.Dictionary.ValueAtKey(dictionary=code_block_99, key=code_block_100)
watch_3 = Watch(valueAtKey_20)

code_block_101 = CodeBlock { "TargetElements"; }
valueAtKey_21 = DesignScript.Builtin.Dictionary.ValueAtKey(dictionary=code_block_16, key=code_block_101)
code_block_102 = CodeBlock { "Volume"; }
getParameterValueByName = Element.GetParameterValueByName(element=valueAtKey_21, parameterName=code_block_102)
code_block_103 = CodeBlock(i=getParameterValueByName) { Math.Round(List.Flatten(i)/1, 2); }
code_block_104 = CodeBlock { "M3"; }
count_3 = List.Count(list=code_block_103)
ofRepeatedItem_3 = List.OfRepeatedItem(item=code_block_104, amount=count_3)
code_block_105 = CodeBlock(FuncValues=code_block_103, FuncValuesUnit=ofRepeatedItem_3)  # same code as code_block_52
volume = Solid.Volume(solid=createExcavationSolid.Solid)
code_block_106 = CodeBlock(i=volume) { Math.Round(List.Flatten(i)/1000000000, 2); }
code_block_107 = CodeBlock { "M3"; }
count_4 = List.Count(list=code_block_106)
ofRepeatedItem_4 = List.OfRepeatedItem(item=code_block_107, amount=count_4)
code_block_108 = CodeBlock(FuncValues=code_block_106, FuncValuesUnit=ofRepeatedItem_4)  # same code as code_block_52
area_3 = Surface.Area(surface=createBaseCourseSurfaces.Surface)
code_block_109 = CodeBlock(i=area_3) { Math.Round(List.Flatten(i)/1000000, 2); }
code_block_110 = CodeBlock { "M2"; }
count_5 = List.Count(list=code_block_109)
ofRepeatedItem_5 = List.OfRepeatedItem(item=code_block_110, amount=count_5)
code_block_111 = CodeBlock(FuncValues=code_block_109, FuncValuesUnit=ofRepeatedItem_5)  # same code as code_block_52
volume_2 = Solid.Volume(solid=createLeanConcrete.Solid)
code_block_112 = CodeBlock(i=volume_2) { Math.Round(List.Flatten(i)/1000000000, 2); }
code_block_113 = CodeBlock { "M3"; }
count_6 = List.Count(list=code_block_112)
ofRepeatedItem_6 = List.OfRepeatedItem(item=code_block_113, amount=count_6)
code_block_114 = CodeBlock(FuncValues=code_block_112, FuncValuesUnit=ofRepeatedItem_6)  # same code as code_block_52
area_4 = Surface.Area(surface=extractSideFacesOfElement.Surface)
sum_3 = Math.Sum(values=area_4)
code_block_115 = CodeBlock(i=sum_3) { Math.Round(List.Flatten(i)/1000000, 2); }
code_block_116 = CodeBlock { "M2"; }
count_7 = List.Count(list=code_block_115)
ofRepeatedItem_7 = List.OfRepeatedItem(item=code_block_116, amount=count_7)
code_block_117 = CodeBlock(FuncValues=code_block_115, FuncValuesUnit=ofRepeatedItem_7)  # same code as code_block_52
code_block_118 = CodeBlock { "TargetElements"; }
valueAtKey_22 = DesignScript.Builtin.Dictionary.ValueAtKey(dictionary=code_block_17, key=code_block_118)
code_block_119 = CodeBlock { "Volume"; }
getParameterValueByName_2 = Element.GetParameterValueByName(element=valueAtKey_22, parameterName=code_block_119)
code_block_120 = CodeBlock { 0.1; }
mul = getParameterValueByName_2 * code_block_120
code_block_121 = CodeBlock(i=mul) { Math.Round(List.Flatten(i)/1, 2); }
code_block_122 = CodeBlock { "TON"; }
count_8 = List.Count(list=code_block_121)
ofRepeatedItem_8 = List.OfRepeatedItem(item=code_block_122, amount=count_8)
code_block_123 = CodeBlock(FuncValues=code_block_121, FuncValuesUnit=ofRepeatedItem_8)  # same code as code_block_52
code_block_124 = CodeBlock { "TargetElements"; }
valueAtKey_23 = DesignScript.Builtin.Dictionary.ValueAtKey(dictionary=code_block_18, key=code_block_124)
createLeanConcrete_4 = Custom[CreateLeanConcrete](Element=valueAtKey_23)
area_5 = Surface.Area(surface=createLeanConcrete_4.Surface)
code_block_125 = CodeBlock(i=area_5) { Math.Round(List.Flatten(i)/1000000, 2); }
code_block_126 = CodeBlock { "M2"; }
count_9 = List.Count(list=code_block_125)
ofRepeatedItem_9 = List.OfRepeatedItem(item=code_block_126, amount=count_9)
code_block_127 = CodeBlock(FuncValues=code_block_125, FuncValuesUnit=ofRepeatedItem_9)  # same code as code_block_52
area_6 = Surface.Area(surface=addItemToFront)
sum_4 = Math.Sum(values=area_6)
code_block_128 = CodeBlock(i=sum_4) { Math.Round(List.Flatten(i)/1000000, 2); }
code_block_129 = CodeBlock { "M2"; }
count_10 = List.Count(list=code_block_128)
ofRepeatedItem_10 = List.OfRepeatedItem(item=code_block_129, amount=count_10)
code_block_130 = CodeBlock(FuncValues=code_block_128, FuncValuesUnit=ofRepeatedItem_10)  # same code as code_block_52
join = List.Join(list0=code_block_105, list1=code_block_108, list2=code_block_111, list3=code_block_114, list4=code_block_117, list5=code_block_123, list6=code_block_127, list7=code_block_130)
code_block_131 = CodeBlock()
# ---------- code_block_131.designscript (3 lines) ----------
[
0,1,2,3,4,5,6,7
];
# ----------------------------------------
organizeFuncValuesAndWorkMasterAsDiction = Custom[OrganizeFuncValuesAndWorkMasterAsDictionary](InputDic1=code_block_8, InputDic2=join, InputIndex=code_block_131)  # Organize FuncValues and WorkMaster As Dictionary
code_block_132 = CodeBlock(InputDic=organizeFuncValuesAndWorkMasterAsDiction) { _InputDic; }
code_block_133 = CodeBlock { "TrTargetFamilyCode"; }
valueAtKey_24 = DesignScript.Builtin.Dictionary.ValueAtKey(dictionary=code_block_132, key=code_block_133)
watch_4 = Watch(valueAtKey_24)
code_block_134 = CodeBlock { "WMforTargetElements"; }
valueAtKey_25 = DesignScript.Builtin.Dictionary.ValueAtKey(dictionary=code_block_132, key=code_block_134)
watch_5 = Watch(valueAtKey_25)
code_block_135 = CodeBlock { "TargetFuncValues"; }
valueAtKey_26 = DesignScript.Builtin.Dictionary.ValueAtKey(dictionary=code_block_132, key=code_block_135)
watch_6 = Watch(valueAtKey_26)
code_block_136 = CodeBlock { "TargetFuncValuesUnit"; }
valueAtKey_27 = DesignScript.Builtin.Dictionary.ValueAtKey(dictionary=code_block_132, key=code_block_136)
watch_7 = Watch(valueAtKey_27)
code_block_137 = CodeBlock { "TargetElements"; }
valueAtKey_28 = DesignScript.Builtin.Dictionary.ValueAtKey(dictionary=selectTargetFamilyInformAsDictionary_2, key=code_block_137)
name = Element.Name(element=valueAtKey_28)
code_block_138 = CodeBlock { "WMforTargetElements"; }
valueAtKey_29 = DesignScript.Builtin.Dictionary.ValueAtKey(dictionary=selectTargetFamilyInformAsDictionary_2, key=code_block_138)

# group: GetUsedFamilyTypeOfModeling
code_block_139 = CodeBlock(InputElement=all_elements_of_category) { _InputElement; }
name_2 = Element.Name(element=code_block_139)
code_block_140 = CodeBlock { "_"; }
split = String.Split(str=name_2, separator0=code_block_140)
firstItem = List.FirstItem(list=split@L2)
uniqueItems = List.UniqueItems(list=firstItem)
code_block_141 = CodeBlock(AllElement=code_block_139, UsedFamilyTypeOfMode=uniqueItems)
# ---------- code_block_141.designscript (4 lines) ----------
{
"AllElement": _AllElement,
"UsedFamilyTypeOfModeling": _UsedFamilyTypeOfModeling
};
# ----------------------------------------

area_7 = Surface.Area(surface=extractUpperFacesOfElement_2.Surface)
sum_5 = Math.Sum(values=area_7)
code_block_142 = CodeBlock(i=sum_5) { Math.Round(List.Flatten(i)/1000000, 2); }
code_block_143 = CodeBlock { "M3"; }
count_11 = List.Count(list=code_block_142)
ofRepeatedItem_11 = List.OfRepeatedItem(item=code_block_143, amount=count_11)
code_block_144 = CodeBlock(FuncValues=code_block_142, FuncValuesUnit=ofRepeatedItem_11)  # same code as code_block_52
code_block_145 = CodeBlock { "TargetElements"; }
valueAtKey_30 = DesignScript.Builtin.Dictionary.ValueAtKey(dictionary=code_block_42, key=code_block_145)
code_block_146 = CodeBlock { "Volume"; }
getParameterValueByName_3 = Element.GetParameterValueByName(element=valueAtKey_30, parameterName=code_block_146)
code_block_147 = CodeBlock(i=getParameterValueByName_3) { Math.Round(List.Flatten(i)/1000000, 2); }
code_block_148 = CodeBlock { "M3"; }
count_12 = List.Count(list=code_block_147)
ofRepeatedItem_12 = List.OfRepeatedItem(item=code_block_148, amount=count_12)
code_block_149 = CodeBlock(FuncValues=code_block_147, FuncValuesUnit=ofRepeatedItem_12)  # same code as code_block_52
code_block_150 = CodeBlock { "TargetElements"; }
valueAtKey_31 = DesignScript.Builtin.Dictionary.ValueAtKey(dictionary=code_block_43, key=code_block_150)
createLeanConcrete_5 = Custom[CreateLeanConcrete](Element=valueAtKey_31)
area_8 = Surface.Area(surface=createLeanConcrete_5.Surface)
code_block_151 = CodeBlock(i=area_8) { Math.Round(List.Flatten(i)/1000000, 2); }
code_block_152 = CodeBlock { "M2"; }
count_13 = List.Count(list=code_block_151)
ofRepeatedItem_13 = List.OfRepeatedItem(item=code_block_152, amount=count_13)
code_block_153 = CodeBlock(FuncValues=code_block_151, FuncValuesUnit=ofRepeatedItem_13)  # same code as code_block_52
map = List.Map()  # unwired: list, function
isNull = Object.IsNull(object=createExcavationSolid_2.Solid)
code_block_154 = CodeBlock { 1; }
mul_2 = _ * code_block_154  # unwired: x
volume_3 = Solid.Volume()  # unwired: solid
if_ = If(test=isNull, true=mul_2, false=volume_3)
code_block_155 = CodeBlock { 0; }
isNull_2 = Object.IsNull()  # unwired: object
replaceByCondition = Replace(item=createExcavationSolid_2.Solid, replaceWith=code_block_155, condition=isNull_2)
laceShortest = List.LaceShortest(combineFunction=map, list0=if_, list1=replaceByCondition)
code_block_156 = CodeBlock(i=laceShortest) { Math.Round(List.Flatten(i)/1000000000, 2); }
code_block_157 = CodeBlock { "M3"; }
count_14 = List.Count(list=code_block_156)
ofRepeatedItem_14 = List.OfRepeatedItem(item=code_block_157, amount=count_14)
code_block_158 = CodeBlock(FuncValues=code_block_156, FuncValuesUnit=ofRepeatedItem_14)  # same code as code_block_52
code_block_159 = CodeBlock { 0; }
code_block_160 = CodeBlock { "TargetElements"; }
valueAtKey_32 = DesignScript.Builtin.Dictionary.ValueAtKey(dictionary=code_block_44, key=code_block_160)
count_15 = List.Count(list=valueAtKey_32@L1)
ofRepeatedItem_15 = List.OfRepeatedItem(item=code_block_159, amount=count_15)
code_block_161 = CodeBlock(i=ofRepeatedItem_15) { Math.Round(List.Flatten(i)/1000000000, 2); }
code_block_162 = CodeBlock { "M3"; }
count_16 = List.Count(list=code_block_161)
ofRepeatedItem_16 = List.OfRepeatedItem(item=code_block_162, amount=count_16)
code_block_163 = CodeBlock(FuncValues=code_block_161, FuncValuesUnit=ofRepeatedItem_16)  # same code as code_block_52
code_block_164 = CodeBlock { 0; }
code_block_165 = CodeBlock { "TargetElements"; }
valueAtKey_33 = DesignScript.Builtin.Dictionary.ValueAtKey(dictionary=code_block_45, key=code_block_165)
count_17 = List.Count(list=valueAtKey_33@L1)
ofRepeatedItem_17 = List.OfRepeatedItem(item=code_block_164, amount=count_17)
code_block_166 = CodeBlock(i=ofRepeatedItem_17) { Math.Round(List.Flatten(i)/1000000000, 2); }
code_block_167 = CodeBlock { "M3"; }
count_18 = List.Count(list=code_block_166)
ofRepeatedItem_18 = List.OfRepeatedItem(item=code_block_167, amount=count_18)
code_block_168 = CodeBlock(FuncValues=code_block_166, FuncValuesUnit=ofRepeatedItem_18)  # same code as code_block_52
area_9 = Surface.Area(surface=createBaseCourseSurfaces_2.Surface)
code_block_169 = CodeBlock(i=area_9) { Math.Round(List.Flatten(i)/1000000, 2); }
code_block_170 = CodeBlock { "M2"; }
count_19 = List.Count(list=code_block_169)
ofRepeatedItem_19 = List.OfRepeatedItem(item=code_block_170, amount=count_19)
code_block_171 = CodeBlock(FuncValues=code_block_169, FuncValuesUnit=ofRepeatedItem_19)  # same code as code_block_52
code_block_172 = CodeBlock { 0; }
code_block_173 = CodeBlock { "TargetElements"; }
valueAtKey_34 = DesignScript.Builtin.Dictionary.ValueAtKey(dictionary=code_block_46, key=code_block_173)
count_20 = List.Count(list=valueAtKey_34@L1)
ofRepeatedItem_20 = List.OfRepeatedItem(item=code_block_172, amount=count_20)
code_block_174 = CodeBlock(i=ofRepeatedItem_20) { Math.Round(List.Flatten(i)/1000000000, 2); }
code_block_175 = CodeBlock { "M3"; }
count_21 = List.Count(list=code_block_174)
ofRepeatedItem_21 = List.OfRepeatedItem(item=code_block_175, amount=count_21)
code_block_176 = CodeBlock(FuncValues=code_block_174, FuncValuesUnit=ofRepeatedItem_21)  # same code as code_block_52
volume_4 = Solid.Volume(solid=createLeanConcrete_2.Solid)
code_block_177 = CodeBlock(i=volume_4) { Math.Round(List.Flatten(i)/1000000000, 2); }
code_block_178 = CodeBlock { "M3"; }
count_22 = List.Count(list=code_block_177)
ofRepeatedItem_22 = List.OfRepeatedItem(item=code_block_178, amount=count_22)
code_block_179 = CodeBlock(FuncValues=code_block_177, FuncValuesUnit=ofRepeatedItem_22)  # same code as code_block_52
code_block_180 = CodeBlock { "TargetElements"; }
valueAtKey_35 = DesignScript.Builtin.Dictionary.ValueAtKey(dictionary=code_block_47, key=code_block_180)
code_block_181 = CodeBlock { "Volume"; }
getParameterValueByName_4 = Element.GetParameterValueByName(element=valueAtKey_35, parameterName=code_block_181)
code_block_182 = CodeBlock { 0.1; }
mul_3 = getParameterValueByName_4 * code_block_182
code_block_183 = CodeBlock(i=mul_3) { Math.Round(List.Flatten(i)/1, 2); }
code_block_184 = CodeBlock { "TON"; }
count_23 = List.Count(list=code_block_183)
ofRepeatedItem_23 = List.OfRepeatedItem(item=code_block_184, amount=count_23)
code_block_185 = CodeBlock(FuncValues=code_block_183, FuncValuesUnit=ofRepeatedItem_23)  # same code as code_block_52
join_2 = List.Join(list0=code_block_144, list1=code_block_149, list2=code_block_52, list3=code_block_153, list4=code_block_158, list5=code_block_163, list6=code_block_168, list7=code_block_171, list8=code_block_176, list9=code_block_179, list10=code_block_185)
code_block_186 = CodeBlock()
# ---------- code_block_186.designscript (3 lines) ----------
[
0,1,2,3,4,5,6,7,8,9,10
];
# ----------------------------------------
organizeFuncValuesAndWorkMasterAsDiction_2 = Custom[OrganizeFuncValuesAndWorkMasterAsDictionary](InputDic1=code_block_32, InputDic2=join_2, InputIndex=code_block_186)
code_block_187 = CodeBlock(InputDic=organizeFuncValuesAndWorkMasterAsDiction_2) { _InputDic; }
code_block_188 = CodeBlock { "TrTargetFamilyCode"; }
valueAtKey_36 = DesignScript.Builtin.Dictionary.ValueAtKey(dictionary=code_block_187, key=code_block_188)
watch_8 = Watch(valueAtKey_36)
code_block_189 = CodeBlock { "WMforTargetElements"; }
valueAtKey_37 = DesignScript.Builtin.Dictionary.ValueAtKey(dictionary=code_block_187, key=code_block_189)
watch_9 = Watch(valueAtKey_37)
code_block_190 = CodeBlock { "TargetFuncValues"; }
valueAtKey_38 = DesignScript.Builtin.Dictionary.ValueAtKey(dictionary=code_block_187, key=code_block_190)
watch_10 = Watch(valueAtKey_38)
code_block_191 = CodeBlock { "TargetFuncValuesUnit"; }
valueAtKey_39 = DesignScript.Builtin.Dictionary.ValueAtKey(dictionary=code_block_187, key=code_block_191)
watch_11 = Watch(valueAtKey_39)
area_10 = Surface.Area(surface=extractUpperFacesOfElement_3.Surface)
sum_6 = Math.Sum(values=area_10)
code_block_192 = CodeBlock(i=sum_6) { Math.Round(List.Flatten(i)/1000000, 2); }
code_block_193 = CodeBlock { "M3"; }
count_24 = List.Count(list=code_block_192)
ofRepeatedItem_24 = List.OfRepeatedItem(item=code_block_193, amount=count_24)
code_block_194 = CodeBlock(FuncValues=code_block_192, FuncValuesUnit=ofRepeatedItem_24)  # same code as code_block_52
code_block_195 = CodeBlock { "TargetElements"; }
valueAtKey_40 = DesignScript.Builtin.Dictionary.ValueAtKey(dictionary=code_block_78, key=code_block_195)
code_block_196 = CodeBlock { "Volume"; }
getParameterValueByName_5 = Element.GetParameterValueByName(element=valueAtKey_40, parameterName=code_block_196)
code_block_197 = CodeBlock(i=getParameterValueByName_5) { Math.Round(List.Flatten(i)/1000000, 2); }
code_block_198 = CodeBlock { "M3"; }
count_25 = List.Count(list=code_block_197)
ofRepeatedItem_25 = List.OfRepeatedItem(item=code_block_198, amount=count_25)
code_block_199 = CodeBlock(FuncValues=code_block_197, FuncValuesUnit=ofRepeatedItem_25)  # same code as code_block_52
code_block_200 = CodeBlock { "TargetElements"; }
valueAtKey_41 = DesignScript.Builtin.Dictionary.ValueAtKey(dictionary=code_block_79, key=code_block_200)
createLeanConcrete_6 = Custom[CreateLeanConcrete](Element=valueAtKey_41)
area_11 = Surface.Area(surface=createLeanConcrete_6.Surface)
code_block_201 = CodeBlock(i=area_11) { Math.Round(List.Flatten(i)/1000000, 2); }
code_block_202 = CodeBlock { "M2"; }
count_26 = List.Count(list=code_block_201)
ofRepeatedItem_26 = List.OfRepeatedItem(item=code_block_202, amount=count_26)
code_block_203 = CodeBlock(FuncValues=code_block_201, FuncValuesUnit=ofRepeatedItem_26)  # same code as code_block_52
map_2 = List.Map()  # unwired: list, function
isNull_3 = Object.IsNull(object=createExcavationSolid_3.Solid)
code_block_204 = CodeBlock { 1; }
mul_4 = _ * code_block_204  # unwired: x
volume_5 = Solid.Volume()  # unwired: solid
if_2 = If(test=isNull_3, true=mul_4, false=volume_5)
code_block_205 = CodeBlock { 0; }
isNull_4 = Object.IsNull()  # unwired: object
replaceByCondition_2 = Replace(item=createExcavationSolid_3.Solid, replaceWith=code_block_205, condition=isNull_4)
laceShortest_2 = List.LaceShortest(combineFunction=map_2, list0=if_2, list1=replaceByCondition_2)
code_block_206 = CodeBlock(i=laceShortest_2) { Math.Round(List.Flatten(i)/1000000000, 2); }
code_block_207 = CodeBlock { "M3"; }
count_27 = List.Count(list=code_block_206)
ofRepeatedItem_27 = List.OfRepeatedItem(item=code_block_207, amount=count_27)
code_block_208 = CodeBlock(FuncValues=code_block_206, FuncValuesUnit=ofRepeatedItem_27)  # same code as code_block_52
code_block_209 = CodeBlock { 0; }
code_block_210 = CodeBlock { "TargetElements"; }
valueAtKey_42 = DesignScript.Builtin.Dictionary.ValueAtKey(dictionary=code_block_80, key=code_block_210)
count_28 = List.Count(list=valueAtKey_42@L1)
ofRepeatedItem_28 = List.OfRepeatedItem(item=code_block_209, amount=count_28)
code_block_211 = CodeBlock(i=ofRepeatedItem_28) { Math.Round(List.Flatten(i)/1000000000, 2); }
code_block_212 = CodeBlock { "M3"; }
count_29 = List.Count(list=code_block_211)
ofRepeatedItem_29 = List.OfRepeatedItem(item=code_block_212, amount=count_29)
code_block_213 = CodeBlock(FuncValues=code_block_211, FuncValuesUnit=ofRepeatedItem_29)  # same code as code_block_52
code_block_214 = CodeBlock { 0; }
code_block_215 = CodeBlock { "TargetElements"; }
valueAtKey_43 = DesignScript.Builtin.Dictionary.ValueAtKey(dictionary=code_block_81, key=code_block_215)
count_30 = List.Count(list=valueAtKey_43@L1)
ofRepeatedItem_30 = List.OfRepeatedItem(item=code_block_214, amount=count_30)
code_block_216 = CodeBlock(i=ofRepeatedItem_30) { Math.Round(List.Flatten(i)/1000000000, 2); }
code_block_217 = CodeBlock { "M3"; }
count_31 = List.Count(list=code_block_216)
ofRepeatedItem_31 = List.OfRepeatedItem(item=code_block_217, amount=count_31)
code_block_218 = CodeBlock(FuncValues=code_block_216, FuncValuesUnit=ofRepeatedItem_31)  # same code as code_block_52
area_12 = Surface.Area(surface=createBaseCourseSurfaces_3.Surface)
code_block_219 = CodeBlock(i=area_12) { Math.Round(List.Flatten(i)/1000000, 2); }
code_block_220 = CodeBlock { "M2"; }
count_32 = List.Count(list=code_block_219)
ofRepeatedItem_32 = List.OfRepeatedItem(item=code_block_220, amount=count_32)
code_block_221 = CodeBlock(FuncValues=code_block_219, FuncValuesUnit=ofRepeatedItem_32)  # same code as code_block_52
code_block_222 = CodeBlock { 0; }
code_block_223 = CodeBlock { "TargetElements"; }
valueAtKey_44 = DesignScript.Builtin.Dictionary.ValueAtKey(dictionary=code_block_82, key=code_block_223)
count_33 = List.Count(list=valueAtKey_44@L1)
ofRepeatedItem_33 = List.OfRepeatedItem(item=code_block_222, amount=count_33)
code_block_224 = CodeBlock(i=ofRepeatedItem_33) { Math.Round(List.Flatten(i)/1000000000, 2); }
code_block_225 = CodeBlock { "M3"; }
count_34 = List.Count(list=code_block_224)
ofRepeatedItem_34 = List.OfRepeatedItem(item=code_block_225, amount=count_34)
code_block_226 = CodeBlock(FuncValues=code_block_224, FuncValuesUnit=ofRepeatedItem_34)  # same code as code_block_52
volume_6 = Solid.Volume(solid=createLeanConcrete_3.Solid)
code_block_227 = CodeBlock(i=volume_6) { Math.Round(List.Flatten(i)/1000000000, 2); }
code_block_228 = CodeBlock { "M3"; }
count_35 = List.Count(list=code_block_227)
ofRepeatedItem_35 = List.OfRepeatedItem(item=code_block_228, amount=count_35)
code_block_229 = CodeBlock(FuncValues=code_block_227, FuncValuesUnit=ofRepeatedItem_35)  # same code as code_block_52
code_block_230 = CodeBlock { "TargetElements"; }
valueAtKey_45 = DesignScript.Builtin.Dictionary.ValueAtKey(dictionary=code_block_83, key=code_block_230)
code_block_231 = CodeBlock { "Volume"; }
getParameterValueByName_6 = Element.GetParameterValueByName(element=valueAtKey_45, parameterName=code_block_231)
code_block_232 = CodeBlock { 0.1; }
mul_5 = getParameterValueByName_6 * code_block_232
code_block_233 = CodeBlock(i=mul_5) { Math.Round(List.Flatten(i)/1, 2); }
code_block_234 = CodeBlock { "TON"; }
count_36 = List.Count(list=code_block_233)
ofRepeatedItem_36 = List.OfRepeatedItem(item=code_block_234, amount=count_36)
code_block_235 = CodeBlock(FuncValues=code_block_233, FuncValuesUnit=ofRepeatedItem_36)  # same code as code_block_52
join_3 = List.Join(list0=code_block_194, list1=code_block_199, list2=code_block_88, list3=code_block_203, list4=code_block_208, list5=code_block_213, list6=code_block_218, list7=code_block_221, list8=code_block_226, list9=code_block_229, list10=code_block_235)
code_block_236 = CodeBlock()  # same code as code_block_186
organizeFuncValuesAndWorkMasterAsDiction_3 = Custom[OrganizeFuncValuesAndWorkMasterAsDictionary](InputDic1=code_block_68, InputDic2=join_3, InputIndex=code_block_236)
code_block_237 = CodeBlock(InputDic=organizeFuncValuesAndWorkMasterAsDiction_3) { _InputDic; }
code_block_238 = CodeBlock { "TrTargetFamilyCode"; }
valueAtKey_46 = DesignScript.Builtin.Dictionary.ValueAtKey(dictionary=code_block_237, key=code_block_238)
watch_12 = Watch(valueAtKey_46)
code_block_239 = CodeBlock { "WMforTargetElements"; }
valueAtKey_47 = DesignScript.Builtin.Dictionary.ValueAtKey(dictionary=code_block_237, key=code_block_239)
watch_13 = Watch(valueAtKey_47)
code_block_240 = CodeBlock { "TargetFuncValues"; }
valueAtKey_48 = DesignScript.Builtin.Dictionary.ValueAtKey(dictionary=code_block_237, key=code_block_240)
watch_14 = Watch(valueAtKey_48)
code_block_241 = CodeBlock { "TargetFuncValuesUnit"; }
valueAtKey_49 = DesignScript.Builtin.Dictionary.ValueAtKey(dictionary=code_block_237, key=code_block_241)
watch_15 = Watch(valueAtKey_49)
