# Dynamo graph Str Foundation Calculator_HEC(0723).dyn (Dynamo 2.10.1.3976)

# group: All Elements of Category - STR FDN
categories = Categories("OST_StructuralFoundation")
all_elements_of_category = ElementsOfCategory(Category=categories)

file_path = Filename(".\BIM_물량집계 자동화 산출기준표_rC(20210722).xlsx")
file_from_path = FileObject(path=file_path)
code_block = CodeBlock { "Scope_lv2(Str Foundations)"; }
getFullWMCodeDescriptionPerElement = Custom[GetFullWMCodeDescriptionPerElement](InputElement=all_elements_of_category, InputFilePath=file_from_path, InputSheetName=code_block)  # GetFullWMCodeDescriptionPerElement
watch = Watch(getFullWMCodeDescriptionPerElement.FullWMCodeDescriptionPerElement)

# group: Total material index
watch_wm_중복제거 = Watch(watch)
flatten = List.Flatten(list=watch_wm_중복제거)

# group: element별 material 개수로 함수 리스트 복제
ofRepeatedItem = List.OfRepeatedItem()  # unwired: item, amount
count = List.Count(list=watch_wm_중복제거@L2)
laceShortest = List.LaceShortest(combineFunction=ofRepeatedItem, list0=all_elements_of_category, list1=count)
watch_2 = Watch(laceShortest)
flatten_2 = List.Flatten(list=watch_2)

# group: Element Filter 적용구간-<element>
watch_element별_material_개수로_함수 = Watch(flatten_2)  # "Watch@element별 material 개수로 함수 리스트 복제"
name = Element.Name(element=watch_element별_material_개수로_함수)
code_block_2 = CodeBlock { "FT211"; }
contains = String.Contains(str=name, searchFor=code_block_2)
filterByBoolMask = List.FilterByBoolMask(list=watch_element별_material_개수로_함수, mask=contains)
countTrue = List.CountTrue(list=contains)

# group: Element Filter 적용구간-<material>
watch_total_material_index = Watch(flatten)
filterByBoolMask_2 = List.FilterByBoolMask(list=watch_total_material_index, mask=contains)

# group: 함수 2-EXCAVATION for ISO FDN [cat.3]
# note: target WM 입력부
code_block_3 = CodeBlock()
# ---------- code_block_3.designscript (5 lines) ----------
[
"A01ZZ001"
//,
//""
];
# ----------------------------------------
faces = Element.Faces(element=filterByBoolMask.in)
flatten_3 = List.Flatten(list=faces)
code_block_4 = CodeBlock { 0.5; }
normalAtParameter = Surface.NormalAtParameter(surface=flatten_3, u=code_block_4, v=code_block_4)
Z = Vector.Z(vector=normalAtParameter)
code_block_5 = CodeBlock(i=Z) { i == -1; }
filterByBoolMask_3 = List.FilterByBoolMask(list=flatten_3, mask=code_block_5)
watch_3 = Watch(filterByBoolMask_3.in)
perimeterCurves = Surface.PerimeterCurves(surface=watch_3)
byJoinedCurves = PolyCurve.ByJoinedCurves(curves=perimeterCurves)
code_block_6 = CodeBlock { 300; }
code_block_7 = CodeBlock { false; }
offset = PolyCurve.Offset(polyCurve=byJoinedCurves, signedDistance=code_block_6, extendCircular=code_block_7)
code_block_8 = CodeBlock { 1500; }
translate = Geometry.Translate(geometry=offset, zTranslation=code_block_8)
code_block_9 = CodeBlock { 1500; }
code_block_10 = CodeBlock { false; }
# note: 함수1 생성 구간
offset_2 = PolyCurve.Offset(polyCurve=translate, signedDistance=code_block_9, extendCircular=code_block_10)
list_create = List.Create(item0=offset, item1=offset_2)
transpose = List.Transpose(lists=list_create)
byLoft = Solid.ByLoft(crossSections=transpose)
volume = Solid.Volume(solid=byLoft)

# group: target WM 적용 함수 - element 매칭 구간
# note: 해당 함수의 target materials index 검색
contains_2 = String.Contains(str=filterByBoolMask_2.in@L1, searchFor=code_block_3)
anyTrue = List.AnyTrue(list=contains_2@L2)
code_block_11 = CodeBlock { true; }
# note: getting index of element which has target materials
allIndicesOf = List.AllIndicesOf(list=anyTrue@L2, item=code_block_11)
flatten_4 = List.Flatten(list=allIndicesOf)
# note: wm 별 타겟 element 추출
getItemAtIndex = List.GetItemAtIndex(list=filterByBoolMask.in, index=flatten_4)
# note: 필요한 개수로 함수 리스트 증식
# note: 엘리먼트와 함수 1대1 매칭 적용
watch_4 = Watch(getItemAtIndex)
watch_material_index = Watch(filterByBoolMask_2.in)
count_2 = List.Count(list=flatten_4)

getItemAtIndex_2 = List.GetItemAtIndex(list=volume, index=flatten_4)
watch_5 = Watch(getItemAtIndex_2)

# group: FamilyName, WorkMasterCode, Quantities, Unit 결합구간
name_2 = Element.Name(element=watch_4)
watch_material_index_2 = Watch(watch_material_index)
getItemAtIndex_3 = List.GetItemAtIndex(list=watch_material_index_2, index=flatten_4)
flatten_5 = List.Flatten(list=watch_5)
watch_6 = Watch(flatten_5)
code_block_12 = CodeBlock { "M3"; }
code_block_13 = CodeBlock(familyName=name_2, workmasterCode=getItemAtIndex_3, quantities=watch_6, unit=code_block_12) { familyName +"..."+ workmasterCode +"..."+ quantities/1000000000 +"..."+ unit; }

# group: Element Filter 적용구간-<element>
watch_element별_material_개수로_함수_2 = Watch(flatten_2)  # "Watch@element별 material 개수로 함수 리스트 복제"
name_3 = Element.Name(element=watch_element별_material_개수로_함수_2)
code_block_14 = CodeBlock { "FT211"; }
contains_3 = String.Contains(str=name_3, searchFor=code_block_14)
filterByBoolMask_4 = List.FilterByBoolMask(list=watch_element별_material_개수로_함수_2, mask=contains_3)
countTrue_2 = List.CountTrue(list=contains_3)

# group: Element Filter 적용구간-<material>
watch_total_material_index_2 = Watch(flatten)
filterByBoolMask_5 = List.FilterByBoolMask(list=watch_total_material_index_2, mask=contains_3)

# group: 함수 4-Base Course for ISO FDN [cat.3]
# note: target WM 입력부
code_block_15 = CodeBlock()
# ---------- code_block_15.designscript (5 lines) ----------
[
"A01ZZ005"
//,
//""
];
# ----------------------------------------
faces_2 = Element.Faces(element=filterByBoolMask_4.in)
flatten_6 = List.Flatten(list=faces_2)
code_block_16 = CodeBlock { 0.5; }
normalAtParameter_2 = Surface.NormalAtParameter(surface=flatten_6, u=code_block_16, v=code_block_16)
Z_2 = Vector.Z(vector=normalAtParameter_2)
code_block_17 = CodeBlock(i=Z_2) { i == -1; }
filterByBoolMask_6 = List.FilterByBoolMask(list=flatten_6, mask=code_block_17)
watch_7 = Watch(filterByBoolMask_6.in)
perimeterCurves_2 = Surface.PerimeterCurves(surface=watch_7)
byJoinedCurves_2 = PolyCurve.ByJoinedCurves(curves=perimeterCurves_2)
code_block_18 = CodeBlock { 300; }
code_block_19 = CodeBlock { false; }
offset_3 = PolyCurve.Offset(polyCurve=byJoinedCurves_2, signedDistance=code_block_18, extendCircular=code_block_19)
code_block_20 = CodeBlock { -100; }
translate_2 = Geometry.Translate(geometry=offset_3, zTranslation=code_block_20)
code_block_21 = CodeBlock { -200; }
# note: 함수1 생성 구간
translate_3 = Geometry.Translate(geometry=translate_2, zTranslation=code_block_21)
list_create_2 = List.Create(item0=translate_2, item1=translate_3)
lastItem = List.LastItem(list=list_create_2)
byPatch = Surface.ByPatch(closedCurve=lastItem)
area = Surface.Area(surface=byPatch)
code_block_22 = CodeBlock { 500; }
code_block_23 = CodeBlock { false; }
transpose_2 = List.Transpose(lists=list_create_2)
byLoft_2 = Solid.ByLoft(crossSections=transpose_2)
volume_2 = Solid.Volume(solid=byLoft_2)

# group: target WM 적용 함수 - element 매칭 구간
# note: 해당 함수의 target materials index 검색
contains_4 = String.Contains(str=filterByBoolMask_5.in@L1, searchFor=code_block_15)
anyTrue_2 = List.AnyTrue(list=contains_4@L2)
code_block_24 = CodeBlock { true; }
# note: getting index of element which has target materials
allIndicesOf_2 = List.AllIndicesOf(list=anyTrue_2@L2, item=code_block_24)
flatten_7 = List.Flatten(list=allIndicesOf_2)
# note: wm 별 타겟 element 추출
getItemAtIndex_4 = List.GetItemAtIndex(list=filterByBoolMask_4.in, index=flatten_7)
# note: 필요한 개수로 함수 리스트 증식
# note: 엘리먼트와 함수 1대1 매칭 적용
watch_8 = Watch(getItemAtIndex_4)
watch_material_index_3 = Watch(filterByBoolMask_5.in)
count_3 = List.Count(list=flatten_7)

getItemAtIndex_5 = List.GetItemAtIndex(list=area, index=flatten_7)
watch_9 = Watch(getItemAtIndex_5)

# group: FamilyName, WorkMasterCode, Quantities, Unit 결합구간
name_4 = Element.Name(element=watch_8)
watch_material_index_4 = Watch(watch_material_index_3)
getItemAtIndex_6 = List.GetItemAtIndex(list=watch_material_index_4, index=flatten_7)
flatten_8 = List.Flatten(list=watch_9)
watch_10 = Watch(flatten_8)
code_block_25 = CodeBlock { "M2"; }
code_block_26 = CodeBlock(familyName=name_4, workmasterCode=getItemAtIndex_6, quantities=watch_10, unit=code_block_25) { familyName +"..."+ workmasterCode +"..."+ quantities/1000000 +"..."+ unit; }

# group: Element Filter 적용구간-<element>
watch_element별_material_개수로_함수_3 = Watch(flatten_2)  # "Watch@element별 material 개수로 함수 리스트 복제"
name_5 = Element.Name(element=watch_element별_material_개수로_함수_3)
code_block_27 = CodeBlock { "FT211"; }
contains_5 = String.Contains(str=name_5, searchFor=code_block_27)
filterByBoolMask_7 = List.FilterByBoolMask(list=watch_element별_material_개수로_함수_3, mask=contains_5)
countTrue_3 = List.CountTrue(list=contains_5)

# group: Element Filter 적용구간-<material>
watch_total_material_index_3 = Watch(flatten)
filterByBoolMask_8 = List.FilterByBoolMask(list=watch_total_material_index_3, mask=contains_5)

# group: 함수 3-Lean Conc for ISO FDN [cat.3]
# note: target WM 입력부
code_block_28 = CodeBlock()
# ---------- code_block_28.designscript (5 lines) ----------
[
"A03AC034"
//,
//""
];
# ----------------------------------------
faces_3 = Element.Faces(element=filterByBoolMask_7.in)
flatten_9 = List.Flatten(list=faces_3)
code_block_29 = CodeBlock { 0.5; }
normalAtParameter_3 = Surface.NormalAtParameter(surface=flatten_9, u=code_block_29, v=code_block_29)
Z_3 = Vector.Z(vector=normalAtParameter_3)
code_block_30 = CodeBlock(i=Z_3) { i == -1; }
filterByBoolMask_9 = List.FilterByBoolMask(list=flatten_9, mask=code_block_30)
watch_11 = Watch(filterByBoolMask_9.in)
perimeterCurves_3 = Surface.PerimeterCurves(surface=watch_11)
byJoinedCurves_3 = PolyCurve.ByJoinedCurves(curves=perimeterCurves_3)
code_block_31 = CodeBlock { 100; }
code_block_32 = CodeBlock { false; }
offset_4 = PolyCurve.Offset(polyCurve=byJoinedCurves_3, signedDistance=code_block_31, extendCircular=code_block_32)
code_block_33 = CodeBlock { -100; }
translate_4 = Geometry.Translate(geometry=offset_4, zTranslation=code_block_33)
# note: 함수1 생성 구간
list_create_3 = List.Create(item0=offset_4, item1=translate_4)
transpose_3 = List.Transpose(lists=list_create_3)
byLoft_3 = Solid.ByLoft(crossSections=transpose_3)
volume_3 = Solid.Volume(solid=byLoft_3)
code_block_34 = CodeBlock { 500; }
code_block_35 = CodeBlock { false; }

# group: target WM 적용 함수 - element 매칭 구간
# note: 해당 함수의 target materials index 검색
contains_6 = String.Contains(str=filterByBoolMask_8.in@L1, searchFor=code_block_28)
anyTrue_3 = List.AnyTrue(list=contains_6@L2)
code_block_36 = CodeBlock { true; }
# note: getting index of element which has target materials
allIndicesOf_3 = List.AllIndicesOf(list=anyTrue_3@L2, item=code_block_36)
flatten_10 = List.Flatten(list=allIndicesOf_3)
# note: wm 별 타겟 element 추출
getItemAtIndex_7 = List.GetItemAtIndex(list=filterByBoolMask_7.in, index=flatten_10)
# note: 필요한 개수로 함수 리스트 증식
# note: 엘리먼트와 함수 1대1 매칭 적용
watch_12 = Watch(getItemAtIndex_7)
watch_material_index_5 = Watch(filterByBoolMask_8.in)
count_4 = List.Count(list=flatten_10)

getItemAtIndex_8 = List.GetItemAtIndex(list=volume_3, index=flatten_10)
watch_13 = Watch(getItemAtIndex_8)

# group: FamilyName, WorkMasterCode, Quantities, Unit 결합구간
name_6 = Element.Name(element=watch_12)
watch_material_index_6 = Watch(watch_material_index_5)
getItemAtIndex_9 = List.GetItemAtIndex(list=watch_material_index_6, index=flatten_10)
flatten_11 = List.Flatten(list=watch_13)
watch_14 = Watch(flatten_11)
code_block_37 = CodeBlock { "M3"; }
code_block_38 = CodeBlock(familyName=name_6, workmasterCode=getItemAtIndex_9, quantities=watch_14, unit=code_block_37) { familyName +"..."+ workmasterCode +"..."+ quantities/1000000000 +"..."+ unit; }

# group: Element Filter 적용구간-<element>
watch_element별_material_개수로_함수_4 = Watch(flatten_2)  # "Watch@element별 material 개수로 함수 리스트 복제"
name_7 = Element.Name(element=watch_element별_material_개수로_함수_4)
code_block_39 = CodeBlock { ""; }
contains_7 = String.Contains(str=name_7, searchFor=code_block_39)
filterByBoolMask_10 = List.FilterByBoolMask(list=watch_element별_material_개수로_함수_4, mask=contains_7)
countTrue_4 = List.CountTrue(list=contains_7)

# group: Element Filter 적용구간-<material>
watch_total_material_index_4 = Watch(flatten)
filterByBoolMask_11 = List.FilterByBoolMask(list=watch_total_material_index_4, mask=contains_7)

# group: 함수 1-Concrete [cat.1]
# note: target WM 입력부
code_block_40 = CodeBlock()
# ---------- code_block_40.designscript (5 lines) ----------
[
"A03AC032"
//,
//""
];
# ----------------------------------------
code_block_41 = CodeBlock { "Volume"; }
# note: 함수1 생성 구간
getParameterValueByName = Element.GetParameterValueByName(parameterName=code_block_41)  # unwired: element
function_compose = ComposeFunctions()  # frozen; unwired: function0, function1
code_block_42 = CodeBlock {  }

# group: target WM 적용 함수 - element 매칭 구간
# note: 해당 함수의 target materials index 검색
contains_8 = String.Contains(str=filterByBoolMask_11.in@L1, searchFor=code_block_40)
anyTrue_4 = List.AnyTrue(list=contains_8@L2)
code_block_43 = CodeBlock { true; }
# note: getting index of element which has target materials
allIndicesOf_4 = List.AllIndicesOf(list=anyTrue_4@L2, item=code_block_43)
flatten_12 = List.Flatten(list=allIndicesOf_4)
# note: wm 별 타겟 element 추출
getItemAtIndex_10 = List.GetItemAtIndex(list=filterByBoolMask_10.in, index=flatten_12)
watch_15 = Watch(getItemAtIndex_10)
watch_material_index_7 = Watch(filterByBoolMask_11.in)
map = List.Map()  # unwired: list, function
count_5 = List.Count(list=flatten_12)
# note: 필요한 개수로 함수 리스트 증식
ofRepeatedItem_2 = List.OfRepeatedItem(item=getParameterValueByName, amount=count_5)
watch_16 = Watch(ofRepeatedItem_2)
# note: 엘리먼트와 함수 1대1 매칭 적용
laceShortest_2 = List.LaceShortest(combineFunction=map, list0=watch_16, list1=watch_15)
count_6 = List.Count(list=laceShortest_2)

# group: FamilyName, WorkMasterCode, Quantities, Unit 결합구간
name_8 = Element.Name(element=watch_15)
watch_material_index_8 = Watch(watch_material_index_7)
getItemAtIndex_11 = List.GetItemAtIndex(list=watch_material_index_8, index=flatten_12)
flatten_13 = List.Flatten(list=laceShortest_2)
watch_17 = Watch(flatten_13)
code_block_44 = CodeBlock { "M3"; }
code_block_45 = CodeBlock(familyName=name_8, workmasterCode=getItemAtIndex_11, quantities=watch_17, unit=code_block_44) { familyName +"..."+ workmasterCode +"..."+ quantities +"..."+ unit; }

# group: Element Filter 적용구간-<element>
watch_element별_material_개수로_함수_5 = Watch(flatten_2)  # "Watch@element별 material 개수로 함수 리스트 복제"
name_9 = Element.Name(element=watch_element별_material_개수로_함수_5)
code_block_46 = CodeBlock { "FT211"; }
contains_9 = String.Contains(str=name_9, searchFor=code_block_46)
filterByBoolMask_12 = List.FilterByBoolMask(list=watch_element별_material_개수로_함수_5, mask=contains_9)
countTrue_5 = List.CountTrue(list=contains_9)

# group: Element Filter 적용구간-<material>
watch_total_material_index_5 = Watch(flatten)
filterByBoolMask_13 = List.FilterByBoolMask(list=watch_total_material_index_5, mask=contains_9)

# group: 함수 5-FormWork for ISO FDN [cat.3]
# note: target WM 입력부
code_block_47 = CodeBlock()
# ---------- code_block_47.designscript (5 lines) ----------
[
"A03AC035"
//,
//""
];
# ----------------------------------------
faces_4 = Element.Faces(element=filterByBoolMask_12.in)
code_block_48 = CodeBlock { 0.5; }
normalAtParameter_4 = Surface.NormalAtParameter(surface=faces_4, u=code_block_48, v=code_block_48)
Z_4 = Vector.Z(vector=normalAtParameter_4)
code_block_49 = CodeBlock(i=Z_4) { i != -1 && i != 1; }
filterByBoolMask_14 = List.FilterByBoolMask(list=faces_4, mask=code_block_49)
# note: 함수1 생성 구간
watch_18 = Watch(filterByBoolMask_14.in)
area_2 = Surface.Area(surface=watch_18)

# group: target WM 적용 함수 - element 매칭 구간
# note: 해당 함수의 target materials index 검색
contains_10 = String.Contains(str=filterByBoolMask_13.in@L1, searchFor=code_block_47)
anyTrue_5 = List.AnyTrue(list=contains_10@L2)
code_block_50 = CodeBlock { true; }
# note: getting index of element which has target materials
allIndicesOf_5 = List.AllIndicesOf(list=anyTrue_5@L2, item=code_block_50)
flatten_14 = List.Flatten(list=allIndicesOf_5)
# note: wm 별 타겟 element 추출
getItemAtIndex_12 = List.GetItemAtIndex(list=filterByBoolMask_12.in, index=flatten_14)
# note: 필요한 개수로 함수 리스트 증식
# note: 엘리먼트와 함수 1대1 매칭 적용
watch_19 = Watch(getItemAtIndex_12)
watch_material_index_9 = Watch(filterByBoolMask_13.in)
count_7 = List.Count(list=flatten_14)

sum = Math.Sum(values=area_2@L2)
getItemAtIndex_13 = List.GetItemAtIndex(list=sum, index=flatten_14)
watch_20 = Watch(getItemAtIndex_13)

# group: FamilyName, WorkMasterCode, Quantities, Unit 결합구간
name_10 = Element.Name(element=watch_19)
watch_material_index_10 = Watch(watch_material_index_9)
getItemAtIndex_14 = List.GetItemAtIndex(list=watch_material_index_10, index=flatten_14)
flatten_15 = List.Flatten(list=watch_20)
watch_21 = Watch(flatten_15)
code_block_51 = CodeBlock { "M2"; }
code_block_52 = CodeBlock(familyName=name_10, workmasterCode=getItemAtIndex_14, quantities=watch_21, unit=code_block_51) { familyName +"..."+ workmasterCode +"..."+ quantities/1000000 +"..."+ unit; }

# group: Element Filter 적용구간-<element>
watch_element별_material_개수로_함수_6 = Watch(flatten_2)  # "Watch@element별 material 개수로 함수 리스트 복제"
name_11 = Element.Name(element=watch_element별_material_개수로_함수_6)
code_block_53 = CodeBlock { ""; }
contains_11 = String.Contains(str=name_11, searchFor=code_block_53)
filterByBoolMask_15 = List.FilterByBoolMask(list=watch_element별_material_개수로_함수_6, mask=contains_11)
countTrue_6 = List.CountTrue(list=contains_11)

# group: Element Filter 적용구간-<material>
watch_total_material_index_6 = Watch(flatten)
filterByBoolMask_16 = List.FilterByBoolMask(list=watch_total_material_index_6, mask=contains_11)

code_block_54 = CodeBlock { 0.1; }
mul = _ * code_block_54  # unwired: x

# group: 함수 8-Rebar [cat.2]
# note: target WM 입력부
code_block_55 = CodeBlock()
# ---------- code_block_55.designscript (5 lines) ----------
[
"A03AC037"
//,
//""
];
# ----------------------------------------
code_block_56 = CodeBlock { "Volume"; }
# note: 함수1 생성 구간
getParameterValueByName_2 = Element.GetParameterValueByName(parameterName=code_block_56)  # unwired: element
function_compose_2 = ComposeFunctions(function0=getParameterValueByName_2, function1=mul)
code_block_57 = CodeBlock {  }

# group: target WM 적용 함수 - element 매칭 구간
# note: 해당 함수의 target materials index 검색
contains_12 = String.Contains(str=filterByBoolMask_16.in@L1, searchFor=code_block_55)
anyTrue_6 = List.AnyTrue(list=contains_12@L2)
code_block_58 = CodeBlock { true; }
# note: getting index of element which has target materials
allIndicesOf_6 = List.AllIndicesOf(list=anyTrue_6@L2, item=code_block_58)
flatten_16 = List.Flatten(list=allIndicesOf_6)
# note: wm 별 타겟 element 추출
getItemAtIndex_15 = List.GetItemAtIndex(list=filterByBoolMask_15.in, index=flatten_16)
watch_22 = Watch(getItemAtIndex_15)
watch_material_index_11 = Watch(filterByBoolMask_16.in)
map_2 = List.Map()  # unwired: list, function
count_8 = List.Count(list=flatten_16)
# note: 필요한 개수로 함수 리스트 증식
ofRepeatedItem_3 = List.OfRepeatedItem(item=function_compose_2, amount=count_8)
watch_23 = Watch(ofRepeatedItem_3)
# note: 엘리먼트와 함수 1대1 매칭 적용
laceShortest_3 = List.LaceShortest(combineFunction=map_2, list0=watch_23, list1=watch_22)
count_9 = List.Count(list=laceShortest_3)

# group: FamilyName, WorkMasterCode, Quantities, Unit 결합구간
name_12 = Element.Name(element=watch_22)
watch_material_index_12 = Watch(watch_material_index_11)
getItemAtIndex_16 = List.GetItemAtIndex(list=watch_material_index_12, index=flatten_16)
flatten_17 = List.Flatten(list=laceShortest_3)
watch_24 = Watch(flatten_17)
code_block_59 = CodeBlock { "TON"; }
code_block_60 = CodeBlock(familyName=name_12, workmasterCode=getItemAtIndex_16, quantities=watch_24, unit=code_block_59) { familyName +"..."+ workmasterCode +"..."+ quantities +"..."+ unit; }

# group: Element Filter 적용구간-<element>
watch_element별_material_개수로_함수_7 = Watch(flatten_2)  # "Watch@element별 material 개수로 함수 리스트 복제"
name_13 = Element.Name(element=watch_element별_material_개수로_함수_7)
code_block_61 = CodeBlock { "FT211"; }
contains_13 = String.Contains(str=name_13, searchFor=code_block_61)
filterByBoolMask_17 = List.FilterByBoolMask(list=watch_element별_material_개수로_함수_7, mask=contains_13)
countTrue_7 = List.CountTrue(list=contains_13)

# group: Element Filter 적용구간-<material>
watch_total_material_index_7 = Watch(flatten)
filterByBoolMask_18 = List.FilterByBoolMask(list=watch_total_material_index_7, mask=contains_13)

# group: 함수 6-Membrane for ISO FDN [cat.3]
# note: target WM 입력부
code_block_62 = CodeBlock()
# ---------- code_block_62.designscript (5 lines) ----------
[
"A03AE059"
//,
//""
];
# ----------------------------------------
faces_5 = Element.Faces(element=filterByBoolMask_17.in)
code_block_63 = CodeBlock { 0.5; }
normalAtParameter_5 = Surface.NormalAtParameter(surface=faces_5, u=code_block_63, v=code_block_63)
Z_5 = Vector.Z(vector=normalAtParameter_5)
code_block_64 = CodeBlock(i=Z_5) { i != -1; }
filterByBoolMask_19 = List.FilterByBoolMask(list=faces_5, mask=code_block_64)
# note: 함수1 생성 구간
watch_25 = Watch(filterByBoolMask_19.in)
area_3 = Surface.Area(surface=watch_25)

# group: target WM 적용 함수 - element 매칭 구간
# note: 해당 함수의 target materials index 검색
contains_14 = String.Contains(str=filterByBoolMask_18.in@L1, searchFor=code_block_62)
anyTrue_7 = List.AnyTrue(list=contains_14@L2)
code_block_65 = CodeBlock { true; }
# note: getting index of element which has target materials
allIndicesOf_7 = List.AllIndicesOf(list=anyTrue_7@L2, item=code_block_65)
flatten_18 = List.Flatten(list=allIndicesOf_7)
# note: wm 별 타겟 element 추출
getItemAtIndex_17 = List.GetItemAtIndex(list=filterByBoolMask_17.in, index=flatten_18)
# note: 필요한 개수로 함수 리스트 증식
# note: 엘리먼트와 함수 1대1 매칭 적용
watch_26 = Watch(getItemAtIndex_17)
watch_material_index_13 = Watch(filterByBoolMask_18.in)
count_10 = List.Count(list=flatten_18)

sum_2 = Math.Sum(values=area_3@L2)
categories_2 = Categories("OST_StructuralColumns")
all_elements_of_category_2 = ElementsOfCategory(Category=categories_2)
faces_6 = Element.Faces(element=all_elements_of_category_2)
code_block_66 = CodeBlock { 0.5; }
normalAtParameter_6 = Surface.NormalAtParameter(surface=faces_6, u=code_block_66, v=code_block_66)
Z_6 = Vector.Z(vector=normalAtParameter_6)
code_block_67 = CodeBlock(i=Z_6) { i == -1; }
filterByBoolMask_20 = List.FilterByBoolMask(list=faces_6, mask=code_block_67)
watch_27 = Watch(filterByBoolMask_20.in)
area_4 = Surface.Area(surface=watch_27)
code_block_68 = CodeBlock(i=area_4) { i[0]; }
sub = sum_2@L1 - code_block_68
getItemAtIndex_18 = List.GetItemAtIndex(list=sub, index=flatten_18)
watch_28 = Watch(getItemAtIndex_18)

# group: FamilyName, WorkMasterCode, Quantities, Unit 결합구간
name_14 = Element.Name(element=watch_26)
watch_material_index_14 = Watch(watch_material_index_13)
getItemAtIndex_19 = List.GetItemAtIndex(list=watch_material_index_14, index=flatten_18)
flatten_19 = List.Flatten(list=watch_28)
watch_29 = Watch(flatten_19)
code_block_69 = CodeBlock { "M2"; }
code_block_70 = CodeBlock(familyName=name_14, workmasterCode=getItemAtIndex_19, quantities=watch_29, unit=code_block_69) { familyName +"..."+ workmasterCode +"..."+ quantities/1000000 +"..."+ unit; }

# group: Element Filter 적용구간-<element>
watch_element별_material_개수로_함수_8 = Watch(flatten_2)  # "Watch@element별 material 개수로 함수 리스트 복제"
name_15 = Element.Name(element=watch_element별_material_개수로_함수_8)
code_block_71 = CodeBlock { "FT211"; }
contains_15 = String.Contains(str=name_15, searchFor=code_block_71)
filterByBoolMask_21 = List.FilterByBoolMask(list=watch_element별_material_개수로_함수_8, mask=contains_15)
countTrue_8 = List.CountTrue(list=contains_15)

# group: Element Filter 적용구간-<material>
watch_total_material_index_8 = Watch(flatten)
filterByBoolMask_22 = List.FilterByBoolMask(list=watch_total_material_index_8, mask=contains_15)

# group: 함수 7-Protection board for ISO FDN [cat.3]
# note: target WM 입력부
code_block_72 = CodeBlock()
# ---------- code_block_72.designscript (5 lines) ----------
[
"A03AE060"
//,
//""
];
# ----------------------------------------
faces_7 = Element.Faces(element=filterByBoolMask_21.in)
code_block_73 = CodeBlock { 0.5; }
normalAtParameter_7 = Surface.NormalAtParameter(surface=faces_7, u=code_block_73, v=code_block_73)
Z_7 = Vector.Z(vector=normalAtParameter_7)
code_block_74 = CodeBlock(i=Z_7) { i != -1; }
filterByBoolMask_23 = List.FilterByBoolMask(list=faces_7, mask=code_block_74)
# note: 함수1 생성 구간
watch_30 = Watch(filterByBoolMask_23.in)
area_5 = Surface.Area(surface=watch_30)

# group: target WM 적용 함수 - element 매칭 구간
# note: 해당 함수의 target materials index 검색
contains_16 = String.Contains(str=filterByBoolMask_22.in@L1, searchFor=code_block_72)
anyTrue_8 = List.AnyTrue(list=contains_16@L2)
code_block_75 = CodeBlock { true; }
# note: getting index of element which has target materials
allIndicesOf_8 = List.AllIndicesOf(list=anyTrue_8@L2, item=code_block_75)
flatten_20 = List.Flatten(list=allIndicesOf_8)
# note: wm 별 타겟 element 추출
getItemAtIndex_20 = List.GetItemAtIndex(list=filterByBoolMask_21.in, index=flatten_20)
# note: 필요한 개수로 함수 리스트 증식
# note: 엘리먼트와 함수 1대1 매칭 적용
watch_31 = Watch(getItemAtIndex_20)
watch_material_index_15 = Watch(filterByBoolMask_22.in)
count_11 = List.Count(list=flatten_20)

sum_3 = Math.Sum(values=area_5@L2)
sub_2 = sum_3@L1 - code_block_68
getItemAtIndex_21 = List.GetItemAtIndex(list=sub_2, index=flatten_20)
watch_32 = Watch(getItemAtIndex_21)

# group: FamilyName, WorkMasterCode, Quantities, Unit 결합구간
name_16 = Element.Name(element=watch_31)
watch_material_index_16 = Watch(watch_material_index_15)
getItemAtIndex_22 = List.GetItemAtIndex(list=watch_material_index_16, index=flatten_20)
flatten_21 = List.Flatten(list=watch_32)
watch_33 = Watch(flatten_21)
code_block_76 = CodeBlock { "M2"; }
code_block_77 = CodeBlock(familyName=name_16, workmasterCode=getItemAtIndex_22, quantities=watch_33, unit=code_block_76) { familyName +"..."+ workmasterCode +"..."+ quantities/1000000 +"..."+ unit; }

# group: DATA 전처리
join = List.Join(list0=code_block_13, list1=code_block_26, list2=code_block_38, list3=code_block_45, list4=code_block_52, list5=code_block_60, list6=code_block_70, list7=code_block_77)
code_block_78 = CodeBlock { "..."; }
split = String.Split(str=join, separator0=code_block_78)
watch_34 = Watch(split)

# group: Export Excel(By OpenpyXl)
python_script_export_excel_by = Python(IN[0]=watch_34)  # "Python Script@Export Excel(By OpenpyXl)"; CPython3; frozen
# ---------- python_script_export_excel_by.python (151 lines) ----------
# Load the Python Standard and DesignScript Libraries
import sys
import os
#sys.path.append(r'C:\Users\HEC\AppData\Local\Programs\Python\Python39\Lib\site-packages')
#sys.path.append(r'C:\Users\pjmk0\AppData\Local\Programs\Python\Python39\Lib\site-packages')
sys.path.append(os.getenv('LOCALAPPDATA').replace('\\','\\\\') + r'\Programs\Python\Python39\Lib\site-packages')
import clr
clr.AddReference('ProtoGeometry')
from Autodesk.DesignScript.Geometry import *
from collections import Iterable

def iterable(obj):
    return isinstance(obj, Iterable)


# The inputs to this node will be stored as a list in the IN variables.
dataEnteringNode = IN
ListIn = IN[0]

# Place your code below this line
import datetime
from datetime import date, timedelta
Today = date.today()
import openpyxl
from openpyxl.styles import Border, Side, PatternFill, Font, GradientFill, Alignment, Color, numbers

sample_items = ListIn


def write_to_file(filepath):
    wb = openpyxl.Workbook()
    for sheet in wb.sheetnames:
        wb.remove(wb[sheet])

    thin = Side(border_style="thin", color="000000")
    double = Side(border_style="double", color="000000")

    ws = wb.create_sheet(title='Str FDN_Calc_instance', index=0)

    ws.merge_cells('A1:L1')
    ws['A1'] = 'HEC Str FDN Category Calculation Sheet'
    cell = ws['A1']
    cell.font = openpyxl.styles.Font(color='000000', size=20)
    cell.fill = openpyxl.styles.fills.PatternFill(patternType='solid',
                                                  fgColor=openpyxl.styles.colors.Color(rgb='fff3b0'))

    ws['A2'] = 'Item Number'
    ws['A2'].font = openpyxl.styles.Font(b=True, color='000000', size=12)
    #ws['B2'] = 'Member Name'
    #ws['B2'].font = openpyxl.styles.Font(b=True, color='000000', size=12)
    #ws['C2'] = 'Category'
    #ws['C2'].font = openpyxl.styles.Font(b=True, color='000000', size=12)
    ws['B2'] = 'Family Type'
    ws['B2'].font = openpyxl.styles.Font(b=True, color='000000', size=12)
    ws['C2'] = 'WorkMaster Code'
    ws['C2'].font = openpyxl.styles.Font(b=True, color='000000', size=12)
    #ws['F2'] = 'WorkMaster Description'
    #ws['F2'].font = openpyxl.styles.Font(b=True, color='000000', size=12)
    #ws['G2'] = 'Unit'
    #ws['G2'].font = openpyxl.styles.Font(b=True, color='000000', size=12)
    #ws['H2'] = '계수'
    #ws['H2'].font = openpyxl.styles.Font(b=True, color='000000', size=12)
    #ws['I2'] = '계산 참조값'
    #ws['I2'].font = openpyxl.styles.Font(b=True, color='000000', size=12)
    ws['D2'] = 'Quantities'
    ws['D2'].font = openpyxl.styles.Font(b=True, color='000000', size=12)
    ws['E2'] = 'Unit'
    ws['E2'].font = openpyxl.styles.Font(b=True, color='000000', size=12)
    ws['F2'] = 'Unit Price'
    ws['F2'].font = openpyxl.styles.Font(b=True, color='000000', size=12)
    ws['G2'] = 'Total Price'
    ws['G2'].font = openpyxl.styles.Font(b=True, color='000000', size=12)


## 칼럼별 너비 조정 구간
#    for col in range(ws.max_column):
#        ws.column_dimensions[chr(ord('A') + col)].width = 15
    ws.column_dimensions['A'].width = 15
    ws.column_dimensions['B'].width = 45
    ws.column_dimensions['C'].width = 60
    ws.column_dimensions['D'].width = 20
    ws.column_dimensions['E'].width = 20
    ws.column_dimensions['F'].width = 20
    ws.column_dimensions['G'].width = 20
    #ws.column_dimensions['G'].width = 9
    #ws.column_dimensions['H'].width = 9
    #ws.column_dimensions['H'].hidden = True
    #ws.column_dimensions['I'].width = 12
    #ws.column_dimensions['I'].hidden = True
    #ws.column_dimensions['J'].width = 12
    #ws.column_dimensions['K'].width = 12
    #ws.column_dimensions['L'].width = 12

###
    start_row = 3
    for (row, item) in enumerate(sample_items, start_row):
        cell = ws.cell(row=row, column=1, value=row - 2)
        cell.alignment = openpyxl.styles.Alignment(horizontal='center', vertical='center')

#        cell = ws.cell(row=row, column=2, value=item[0])
#        cell.number_format = openpyxl.styles.numbers.FORMAT_DATE_YYYYMMDD2  # 'yyyy-mm-dd'
        ws.cell(row=row, column=2, value=item[0]) ## Family Type 칼럼

        ws.cell(row=row, column=3, value=item[1]) ## WorkMaster Code 칼럼
        
        ws.cell(row=row, column=4, value=item[2]) ## Quantities 칼럼
        
        ws.cell(row=row, column=5, value=item[3]) ## Unit 칼럼
        
        #cell = ws.cell(row=row, column=8, value=item[6]) ## 계수 칼럼
        #cell.number_format = openpyxl.styles.numbers.builtin_format_code(3)  # '#,##0'
        
        #cell = ws.cell(row=row, column=9, value=item[7]) ## 계산 참조값 칼럼
        #cell.number_format = openpyxl.styles.numbers.builtin_format_code(3)  # '#,##0'
        
        #cell = ws.cell(row=row, column=10, value=item[8]) ## Quantities 칼럼
        #cell.number_format = openpyxl.styles.numbers.builtin_format_code(3)  # '#,##0'
        #cell.font = openpyxl.styles.Font(b=True, color='000000', size=11)

        cell = ws.cell(row=row, column=7, value='= D{current_row}*F{current_row}'.format(current_row=cell.row))
        cell.number_format = '#,##0'

#        cell = ws.cell(row=row, column=6, value='= D{current_row} * E{current_row}'.format(current_row=cell.row))
#        cell.number_format = openpyxl.styles.numbers.builtin_format_code(3)

    total_row = ws.max_row + 1
    if total_row > start_row:
        cell1 = ws.cell(row=total_row, column=6, value='Total')
        cell1.font = openpyxl.styles.Font(b=True, color='000000', size=15)
        
        cell2 = ws.cell(row=total_row, column=7, value='= SUM(G{}:G{})'.format(start_row, total_row - 1))
        cell2.number_format = openpyxl.styles.numbers.builtin_format_code(3)
        cell2.border = Border(top=double, left=double, right=double, bottom=double)
        cell2.font = openpyxl.styles.Font(b=True, color='ff03ce', size=15)
    

    wb.save(filepath)
    wb.close()


##if __name__ == '__main__':
#write_to_file('C:\\Users\\pjmk0\\AppData\\Roaming\\test.xlsx')

save_name = "HEC_CalcSheet1_Str FDN_" + Today.strftime("%Y-%m-%d")+".xlsx"
path = os.getenv('APPDATA').replace('\\','\\\\')
filePath = path + '\\' + save_name

write_to_file(filePath)

# Assign your output to the OUT variable.
OUT = os.getenv('APPDATA')
# ----------------------------------------

count_12 = List.Count(list=watch_wm_중복제거@L2)

# group: See Virtual Modeling
code_block_79 = CodeBlock { 100; }
byARGB = Color.ByARGB(a=code_block_79, g=code_block_79)
byGeometryColor = Modifiers.GeometryColor.ByGeometryColor(geometry=byLoft, color=byARGB)

# group: See Virtual Modeling
code_block_80 = CodeBlock { 100; }
byARGB_2 = Color.ByARGB(a=code_block_80, r=code_block_80)
byGeometryColor_2 = Modifiers.GeometryColor.ByGeometryColor(geometry=byLoft_3, color=byARGB_2)

# group: See Virtual Modeling
code_block_81 = CodeBlock { 100; }
byARGB_3 = Color.ByARGB(a=code_block_81, b=code_block_81)
byGeometryColor_3 = Modifiers.GeometryColor.ByGeometryColor(geometry=byLoft_2, color=byARGB_3)

# group: See Virtual Modeling
code_block_82 = CodeBlock { 50; }
byARGB_4 = Color.ByARGB(a=code_block_82, r=code_block_82, b=code_block_82)
byGeometryColor_4 = Modifiers.GeometryColor.ByGeometryColor(geometry=watch_18, color=byARGB_4)

# group: See Virtual Modeling
code_block_83 = CodeBlock { 50; }
byARGB_5 = Color.ByARGB(a=code_block_83, r=code_block_83, b=code_block_83)
byGeometryColor_5 = Modifiers.GeometryColor.ByGeometryColor(geometry=watch_25, color=byARGB_5)

# group: See Virtual Modeling
code_block_84 = CodeBlock { 50; }
byARGB_6 = Color.ByARGB(a=code_block_84, r=code_block_84, b=code_block_84)
byGeometryColor_6 = Modifiers.GeometryColor.ByGeometryColor(geometry=watch_30, color=byARGB_6)

watch_35 = Watch(getFullWMCodeDescriptionPerElement.Dictionary)
code_block_85 = CodeBlock { "FullWMCodeDescriptionPerElement"; }
valueAtKey = DesignScript.Builtin.Dictionary.ValueAtKey(dictionary=watch_35, key=code_block_85)
flatten_22 = List.Flatten(list=valueAtKey)
uniqueItems = List.UniqueItems(list=flatten_22)
code_block_86 = CodeBlock { 1800; }
createExcavationSolid = Custom[CreateExcavationSolid](Element=all_elements_of_category, ExcavOffsetTop=code_block_86)  # CreateExcavationSolidForISOFDN
