# Dynamo graph Str Framing Calculator_DataStructureTest(0727).dyn (Dynamo 2.10.1.3976)

code_block = CodeBlock {  }
code_block_2 = CodeBlock {  }

# group: All Elements of Category -Str Framing
categories = Categories("OST_StructuralFraming")
all_elements_of_category = ElementsOfCategory(Category=categories)

# group: preview
geometry = Element.Geometry(element=all_elements_of_category)

# group: Excel Import
file_path = Filename("..\BIM_물량집계 자동화 산출기준표_rC(20210713)_KCS.xlsx")
file_from_path = FileObject(path=file_path)
string_from_object = FromObject(object=file_from_path)
code_block_3 = CodeBlock { "Scope_lv2(Str Framing)"; }
python_script_import_excel_by = Python(IN[0]=string_from_object, IN[1]=code_block_3)  # "Python Script@Import Excel(By OpenpyXl)"; CPython3
# ---------- python_script_import_excel_by.python (50 lines) ----------
# Load the Python Standard and DesignScript Libraries
import sys
import os
#sys.path.append(r'C:\Users\HEC\AppData\Local\Programs\Python\Python39\Lib\site-packages')
#sys.path.append(r'C:\Users\pjmk0\AppData\Local\Programs\Python\Python39\Lib\site-packages')
sys.path.append(os.getenv('LOCALAPPDATA').replace('\\','\\\\') + r'\Programs\Python\Python39\Lib\site-packages')
import clr
clr.AddReference('ProtoGeometry')
from Autodesk.DesignScript.Geometry import *
from collections import Iterable

def iterable(obj):
    return isinstance(obj, Iterable)


# The inputs to this node will be stored as a list in the IN variables.
dataEnteringNode = IN
PathIn = IN[0]
SheetNameIn = IN[1]

# Place your code below this line
import datetime
import openpyxl

path = (PathIn)
#path = (r'C:\Users\pjmk0\Downloads\MK\mQ\BIM_물량집계 자동화 산출기준표_rC(20210607)_mk_de.xlsx')

wb_obj = openpyxl.load_workbook(path, data_only=True)
sheet_obj = wb_obj.get_sheet_by_name(SheetNameIn)

m_row = sheet_obj.max_row
m_col = sheet_obj.max_column

listOut = []



for i in range(1, m_row +1):
    listTemp = []
    for j in range(1, m_col + 1):
        cell_obj = sheet_obj.cell(row=i, column=j)
        listTemp.append(cell_obj.value)
        if len(listTemp) == m_col:
            listOut.append(listTemp)
        


# Assign your output to the OUT variable.
OUT = listOut
#OUT = os.getenv('APPDATA')
# ----------------------------------------
code_block_4 = CodeBlock { false; }
importExcel = Data.ImportExcel(file=file_from_path, sheetName=code_block_3, showExcel=code_block_4)  # frozen

# group: Whole Data(Column direction)
transpose = List.Transpose(lists=python_script_import_excel_by)
watch = Watch(transpose)

# group: Whole Data(row direction)
watch_2 = Watch(python_script_import_excel_by)

# group: Column Index Guide
code_block_5 = CodeBlock(i=watch_2) { i[3]; }
watch_3 = Watch(code_block_5)

# group: All Elements of Category
watch_all_elements_of_category = Watch(all_elements_of_category)  # "Watch@All Elements of Category - Str Framing"

# group: 모델링에 사용된 모든 패밀리타입 코드 추출
name = Element.Name(element=watch_all_elements_of_category)
uniqueItems = List.UniqueItems(list=name@L2)
flatten = List.Flatten(list=uniqueItems)
watch_4 = Watch(flatten)
code_block_6 = CodeBlock { "_"; }
split = String.Split(str=watch_4, separator0=code_block_6)
firstItem = List.FirstItem(list=split@L2)

# group: 사용된 패밀리타입이 위치한 Column Index 추출
string_from_object_2 = FromObject(object=watch_3)
contains = String.Contains(searchFor=firstItem, lacing=CrossProduct)  # unwired: str
map = List.Map(list=string_from_object_2, function=contains)
allFalse = List.AllFalse(list=map@L2)
code_block_7 = CodeBlock(i=allFalse) { i==false?true:false; }
code_block_8 = CodeBlock { true; }
allIndicesOf = List.AllIndicesOf(list=code_block_7, item=code_block_8)

# group: 사용된 패밀리타입 Column Data 추출
watch_5 = Watch(allIndicesOf)
getItemAtIndex = List.GetItemAtIndex(list=watch, index=watch_5)
code_block_9 = CodeBlock { 4; ""; }
# note: 불필요 정보 처리
replaceItemAtIndex = List.ReplaceItemAtIndex(list=getItemAtIndex@L2, index=code_block_9.out0, item=code_block_9.out1)
watch_6 = Watch(getItemAtIndex)

whole_data_row_direction = Object.Identity(object=watch_2)

# group: 사용된 패밀리 타입에서 세부코드가 기입된 Row 열 번호 추출
string_from_object_3 = FromObject(object=replaceItemAtIndex)
code_block_10 = CodeBlock { "000"; }
contains_2 = String.Contains(str=string_from_object_3@L2, searchFor=code_block_10, lacing=CrossProduct)
code_block_11 = CodeBlock { true; }
allIndicesOf_2 = List.AllIndicesOf(list=contains_2@L2, item=code_block_11)
watch_7 = Watch(allIndicesOf_2)

# group: WM code 추출
watch_8 = Watch(replaceItemAtIndex)
whole_data_row_direction_2 = Object.Identity(object=whole_data_row_direction)
getItemAtIndex_2 = List.GetItemAtIndex(list=whole_data_row_direction_2, index=watch_7@L2)
watch_9 = Watch(getItemAtIndex_2)
code_block_12 = CodeBlock { 3; }
getItemAtIndex_3 = List.GetItemAtIndex(list=watch_9@@L2, index=code_block_12)
watch_10 = Watch(getItemAtIndex_3)
code_block_13 = CodeBlock { 2; }
getItemAtIndex_4 = List.GetItemAtIndex(list=watch_9@@L2, index=code_block_13)
watch_11 = Watch(getItemAtIndex_4)
code_block_14 = CodeBlock(i=whole_data_row_direction_2) { i[3]; }
watch_12 = Watch(code_block_14)
code_block_15 = CodeBlock { 4; }
getItemAtIndex_5 = List.GetItemAtIndex(list=watch_9@@L2, index=code_block_15)
watch_13 = Watch(getItemAtIndex_5)
code_block_16 = CodeBlock { 0; }
getItemAtIndex_6 = List.GetItemAtIndex(list=watch_9@@L2, index=code_block_16)
watch_14 = Watch(getItemAtIndex_6)
getItemAtIndex_7 = List.GetItemAtIndex(list=watch_8@@L2, index=watch_7@L2)
watch_15 = Watch(getItemAtIndex_7)
code_block_17 = CodeBlock(i=watch_14, j=watch_15) { i + "-" + j; }

# group: Family Type: WM Code 딕셔너리 생성(모델링에 포함 되지 않은 WM code 까지 포함되어야함)
code_block_18 = CodeBlock { 3; }
getItemAtIndex_8 = List.GetItemAtIndex(list=watch_8@L2, index=code_block_18)
code_block_19 = CodeBlock { "_"; "-"; }
split_2 = String.Split(str=getItemAtIndex_8, separator0=code_block_19.out0, separator1=code_block_19.out1)
firstItem_2 = List.FirstItem(list=split_2@L2)
byKeysValues = DesignScript.Builtin.Dictionary.ByKeysValues(keys=firstItem_2)  # unwired: values
python_script = Python(IN[0]=firstItem_2)  # IronPython2
# ---------- python_script.python (22 lines) ----------
# Load the Python Standard and DesignScript Libraries
import sys
import clr
clr.AddReference('ProtoGeometry')
from Autodesk.DesignScript.Geometry import *

# The inputs to this node will be stored as a list in the IN variables.
dataEnteringNode = IN

# Place your code below this line
familyNameInput = IN[0]

listOut = []
for i in range(len(familyNameInput)):
	processedString = familyNameInput[i] + "." + str(i)
	listOut.append(processedString)




# Assign your output to the OUT variable.
OUT = listOut
# ----------------------------------------
byKeysValues_2 = DesignScript.Builtin.Dictionary.ByKeysValues(keys=python_script, values=code_block_17)
watch_16 = Watch(byKeysValues_2)

# group: D. Family Type
watch_all_elements_of_category_2 = Watch(watch_all_elements_of_category)  # "Watch@All Elements of Category - Str Framing"
name_2 = Element.Name(element=watch_all_elements_of_category_2)

# group: Row Index Guide
code_block_20 = CodeBlock(i=watch) { i[3]; }
watch_17 = Watch(code_block_20)

# group: C. Category
code_block_21 = CodeBlock { "Category"; }
getParameterValueByName = Element.GetParameterValueByName(element=watch_all_elements_of_category, parameterName=code_block_21)

# group: material inform from excel sheet <per family type>
watch_18 = Watch(watch_16)

# group: material inform from excel sheet <per element>
name_3 = Element.Name(element=watch_all_elements_of_category_2)
keys = DesignScript.Builtin.Dictionary.Keys(dictionary=watch_18)
sort = List.Sort(list=keys)
code_block_22 = CodeBlock { "."; }
split_3 = String.Split(str=sort, separator0=code_block_22)
firstItem_3 = List.FirstItem(list=split_3@L2)
contains_3 = String.Contains(str=name_3, searchFor=firstItem_3, lacing=CrossProduct)
code_block_23 = CodeBlock { true; }
allIndicesOf_3 = List.AllIndicesOf(list=contains_3@L2, item=code_block_23)
firstItem_4 = List.FirstItem(list=allIndicesOf_3@L2)
getItemAtIndex_9 = List.GetItemAtIndex(list=sort, index=firstItem_4)
valueAtKey = DesignScript.Builtin.Dictionary.ValueAtKey(dictionary=watch_18, key=getItemAtIndex_9)

# group: Excel 미포함 객체 제외
anyTrue = List.AnyTrue(list=contains_3@L2)
filterByBoolMask = List.FilterByBoolMask(list=watch_all_elements_of_category_2, mask=anyTrue)

# group: Element (Excel 미포함 객체 제외)
watch_workmaster_미포함_객체_제외_임시 = Watch(filterByBoolMask.in)

# group: material inform from modeling <per element>
getMaterials = Element.GetMaterials(element=filterByBoolMask.in)
name_4 = Element.Name(element=getMaterials)
code_block_24 = CodeBlock { "_"; }
split_4 = String.Split(str=name_4, separator0=code_block_24)
firstItem_5 = List.FirstItem(list=split_4@L2)
count = List.Count(list=getMaterials@L2)
chop = List.Chop(list=firstItem_5, lengths=count)

# group: 합집합
list_create = List.Create(item0=chop, item1=valueAtKey)
transpose_2 = List.Transpose(lists=list_create)
watch_19 = Watch(transpose_2)
code_block_25 = CodeBlock { 1; }
flatten_2 = List.Flatten(list=watch_19@L3, amt=code_block_25)

# group: WM 중복제거
uniqueItems_2 = List.UniqueItems(list=flatten_2@L2)

# group: Total material index
watch_wm_중복제거 = Watch(uniqueItems_2)
flatten_3 = List.Flatten(list=watch_wm_중복제거)

# group: 각 element 별 material 개수로 복제
ofRepeatedItem = List.OfRepeatedItem()  # unwired: item, amount
count_2 = List.Count(list=watch_wm_중복제거@L2)
laceShortest = List.LaceShortest(combineFunction=ofRepeatedItem, list0=watch_workmaster_미포함_객체_제외_임시, list1=count_2)
watch_20 = Watch(laceShortest)
flatten_4 = List.Flatten(list=watch_20)

# group: Element Filter 적용구간 - <element> : Steel
watch_각_element별_material_개수로 = Watch(flatten_4)  # "Watch@각 element별 material 개수로 리스트 복제"
elementType = Element.ElementType(element=watch_각_element별_material_개수로)
familyName = ElementType.FamilyName(elementType=elementType)
code_block_26 = CodeBlock { "Steel"; }
contains_4 = String.Contains(str=familyName, searchFor=code_block_26)
count_3 = List.Count(list=contains_4)
filterByBoolMask_2 = List.FilterByBoolMask(list=watch_각_element별_material_개수로, mask=contains_4)
watch_21 = Watch(filterByBoolMask_2.in)

# group: Element Filter 적용구간 - <element> : Concrete UG
watch_각_element별_material_개수로_2 = Watch(flatten_4)  # "Watch@각 element별 material 개수로 리스트 복제"
elementType_2 = Element.ElementType(element=watch_각_element별_material_개수로_2)
string_from_object_4 = FromObject(object=elementType_2)
code_block_27 = CodeBlock()
# ---------- code_block_27.designscript (5 lines) ----------
[
"Concrete"
,
"UG"
];
# ----------------------------------------
contains_5 = String.Contains(str=string_from_object_4@L1, searchFor=code_block_27)
allTrue = List.AllTrue(list=contains_5@L2)
filterByBoolMask_3 = List.FilterByBoolMask(list=watch_각_element별_material_개수로_2, mask=allTrue)
count_4 = List.Count(list=contains_5)

# group: Element Filter 적용구간 - <material> : Concrete UG
watch_total_material_index = Watch(flatten_3)
filterByBoolMask_4 = List.FilterByBoolMask(list=watch_total_material_index, mask=allTrue)

# group: Element Filter 적용구간 - <element> : Concrete AG
watch_각_element별_material_개수로_3 = Watch(flatten_4)  # "Watch@각 element별 material 개수로 리스트 복제"
elementType_3 = Element.ElementType(element=watch_각_element별_material_개수로_3)
string_from_object_5 = FromObject(object=elementType_3)
code_block_28 = CodeBlock()
# ---------- code_block_28.designscript (5 lines) ----------
[
"Concrete"
,
"AG"
];
# ----------------------------------------
contains_6 = String.Contains(str=string_from_object_5@L1, searchFor=code_block_28)
allTrue_2 = List.AllTrue(list=contains_6@L2)
filterByBoolMask_5 = List.FilterByBoolMask(list=watch_각_element별_material_개수로_3, mask=allTrue_2)
count_5 = List.Count(list=contains_6)

# group: Element Filter 적용구간 - <material> : Concrete AG
watch_total_material_index_2 = Watch(flatten_3)
filterByBoolMask_6 = List.FilterByBoolMask(list=watch_total_material_index_2, mask=allTrue_2)

# group: 함수 1 - Steel 중량 산출 (Ton) [Cat.2] Unit Weight x Length
elementType_4 = Element.ElementType(element=watch_21)
list_create_2 = List.Create(item0=elementType_4)
# note: target WM 입력부
code_block_29 = CodeBlock()
# ---------- code_block_29.designscript (15 lines) ----------
[
"S01AA001",
"S01AA002",
"S01AA003",
"S01AA004",
"S01AA005",
"S01AA006",
"S01AA007",
"S01AA008",
"S03AA027",
"S03AA028",
"S03AA029",
"S03AA007",
"S03AA008"
];
# ----------------------------------------
code_block_30 = CodeBlock { "Length"; }
# note: Length 추출
getParameterValueByName_2 = Element.GetParameterValueByName(element=watch_21, parameterName=code_block_30)
code_block_31 = CodeBlock(i=getParameterValueByName_2) { i[]*0.001; }
code_block_32 = CodeBlock { "Mass per Unit Length"; }
# note: Mass per Unit Length (kg/m) 추출
getParameterValueByName_3 = Element.GetParameterValueByName(element=elementType_4, parameterName=code_block_32)
# note: 단위변환 kg -> ton
# note: 단위변환 mm -> m
code_block_33 = CodeBlock(i=getParameterValueByName_3) { i[]*0.001; }
mul = code_block_31 * code_block_33

# group: 함수 2 - Steel Surface Area 물량 (m2) Unit Surface Area x Length
elementType_5 = Element.ElementType(element=watch_21)
list_create_3 = List.Create(item0=elementType_5)
# note: target WM 입력부
code_block_34 = CodeBlock()
# ---------- code_block_34.designscript (8 lines) ----------
[
"S01AA010",
"S03AE015",
"F01AA000",
"F01AB000",
"F01AC000",
"F01AD000"
];
# ----------------------------------------
code_block_35 = CodeBlock { "Length"; }
# note: Length 추출
getParameterValueByName_4 = Element.GetParameterValueByName(element=watch_21, parameterName=code_block_35)
code_block_36 = CodeBlock(i=getParameterValueByName_4) { i[]*0.001; }
code_block_37 = CodeBlock { "Surface Area"; }
# note: Unit Surface Area (m2/m) 추출
getParameterValueByName_5 = Element.GetParameterValueByName(element=elementType_5, parameterName=code_block_37)
# note: 단위변환 mm -> m
code_block_38 = CodeBlock(i=getParameterValueByName_5) { i[]*0.001; }
mul_2 = code_block_36 * code_block_38

# group: Element Filter 적용구간 - <material> : Steel
watch_total_material_index_3 = Watch(flatten_3)
filterByBoolMask_7 = List.FilterByBoolMask(list=watch_total_material_index_3, mask=contains_4)
watch_22 = Watch(filterByBoolMask_7.in)

# group: target WM 적용 함수 - element 매칭 구간
watch_material_index = Watch(watch_22)
# note: 해당 함수의 target materials index 검색
contains_7 = String.Contains(str=watch_material_index@L1, searchFor=code_block_29)
anyTrue_2 = List.AnyTrue(list=contains_7@L2)
boolean = BoolSelector(true)
# note: getting index of element which has target materials
allIndicesOf_4 = List.AllIndicesOf(list=anyTrue_2@L2, item=boolean)
flatten_5 = List.Flatten(list=allIndicesOf_4)
getItemAtIndex_10 = List.GetItemAtIndex(list=watch_21, index=flatten_5)
watch_23 = Watch(getItemAtIndex_10)
getItemAtIndex_11 = List.GetItemAtIndex(list=mul, index=flatten_5)
watch_24 = Watch(getItemAtIndex_11)

# group: FamilyName, WorkMasterCode, Quantities, Unit 결합구간
name_5 = Element.Name(element=watch_23)
watch_material_index_2 = Watch(watch_material_index)
getItemAtIndex_12 = List.GetItemAtIndex(list=watch_material_index_2, index=flatten_5)
flatten_6 = List.Flatten(list=watch_24)
watch_25 = Watch(flatten_6)
code_block_39 = CodeBlock { "Ton"; }
code_block_40 = CodeBlock(familyName=name_5, workmasterCode=getItemAtIndex_12, quantities=watch_25, unit=code_block_39) { familyName +"..."+ workmasterCode +"..."+ quantities +"..."+ unit; }

# group: target WM 적용 함수 - element 매칭 구간
watch_material_index_3 = Watch(watch_22)
# note: 해당 함수의 target materials index 검색
contains_8 = String.Contains(str=watch_material_index_3@L1, searchFor=code_block_34)
anyTrue_3 = List.AnyTrue(list=contains_8@L2)
boolean_2 = BoolSelector(true)
# note: getting index of element which has target materials
allIndicesOf_5 = List.AllIndicesOf(list=anyTrue_3@L2, item=boolean_2)
flatten_7 = List.Flatten(list=allIndicesOf_5)
getItemAtIndex_13 = List.GetItemAtIndex(list=watch_21, index=flatten_7)
watch_26 = Watch(getItemAtIndex_13)
getItemAtIndex_14 = List.GetItemAtIndex(list=mul_2, index=flatten_7)
watch_27 = Watch(getItemAtIndex_14)

# group: FamilyName, WorkMasterCode, Quantities, Unit 결합구간
name_6 = Element.Name(element=watch_26)
watch_material_index_4 = Watch(watch_material_index_3)
getItemAtIndex_15 = List.GetItemAtIndex(list=watch_material_index_4, index=flatten_7)
flatten_8 = List.Flatten(list=watch_27)
watch_28 = Watch(flatten_8)
code_block_41 = CodeBlock { "M2"; }
code_block_42 = CodeBlock(familyName=name_6, workmasterCode=getItemAtIndex_15, quantities=watch_28, unit=code_block_41) { familyName +"..."+ workmasterCode +"..."+ quantities +"..."+ unit; }

# group: DATA 전처리
join = List.Join(list0=code_block_40, list1=code_block_42)
code_block_43 = CodeBlock { "..."; }
split_5 = String.Split(str=join, separator0=code_block_43)
watch_29 = Watch(split_5)

# group: Export Excel(By OpenpyXl)
python_script_export_excel_by = Python(IN[0]=watch_29)  # "Python Script@Export Excel(By OpenpyXl)"; CPython3; frozen
# ---------- python_script_export_excel_by.python (151 lines) ----------
# Load the Python Standard and DesignScript Libraries
import sys
import os
#sys.path.append(r'C:\Users\HEC\AppData\Local\Programs\Python\Python39\Lib\site-packages')
#sys.path.append(r'C:\Users\pjmk0\AppData\Local\Programs\Python\Python39\Lib\site-packages')
sys.path.append(os.getenv('LOCALAPPDATA').replace('\\','\\\\') + r'\Programs\Python\Python39\Lib\site-packages')
import clr
clr.AddReference('ProtoGeometry')
from Autodesk.DesignScript.Geometry import *
from collections import Iterable

def iterable(obj):
    return isinstance(obj, Iterable)


# The inputs to this node will be stored as a list in the IN variables.
dataEnteringNode = IN
ListIn = IN[0]

# Place your code below this line
import datetime
from datetime import date, timedelta
Today = date.today()
import openpyxl
from openpyxl.styles import Border, Side, PatternFill, Font, GradientFill, Alignment, Color, numbers

sample_items = ListIn


def write_to_file(filepath):
    wb = openpyxl.Workbook()
    for sheet in wb.sheetnames:
        wb.remove(wb[sheet])

    thin = Side(border_style="thin", color="000000")
    double = Side(border_style="double", color="000000")

    ws = wb.create_sheet(title='Str Framing_Calc_instance', index=0)

    ws.merge_cells('A1:L1')
    ws['A1'] = 'HEC Structural Framing Category Calculation Sheet'
    cell = ws['A1']
    cell.font = openpyxl.styles.Font(color='000000', size=20)
    cell.fill = openpyxl.styles.fills.PatternFill(patternType='solid',
                                                  fgColor=openpyxl.styles.colors.Color(rgb='fff3b0'))

    ws['A2'] = 'Item Number'
    ws['A2'].font = openpyxl.styles.Font(b=True, color='000000', size=12)
    #ws['B2'] = 'Member Name'
    #ws['B2'].font = openpyxl.styles.Font(b=True, color='000000', size=12)
    #ws['C2'] = 'Category'
    #ws['C2'].font = openpyxl.styles.Font(b=True, color='000000', size=12)
    ws['B2'] = 'Family Type'
    ws['B2'].font = openpyxl.styles.Font(b=True, color='000000', size=12)
    ws['C2'] = 'WorkMaster Code'
    ws['C2'].font = openpyxl.styles.Font(b=True, color='000000', size=12)
    #ws['F2'] = 'WorkMaster Description'
    #ws['F2'].font = openpyxl.styles.Font(b=True, color='000000', size=12)
    #ws['G2'] = 'Unit'
    #ws['G2'].font = openpyxl.styles.Font(b=True, color='000000', size=12)
    #ws['H2'] = '계수'
    #ws['H2'].font = openpyxl.styles.Font(b=True, color='000000', size=12)
    #ws['I2'] = '계산 참조값'
    #ws['I2'].font = openpyxl.styles.Font(b=True, color='000000', size=12)
    ws['D2'] = 'Quantities'
    ws['D2'].font = openpyxl.styles.Font(b=True, color='000000', size=12)
    ws['E2'] = 'Unit'
    ws['E2'].font = openpyxl.styles.Font(b=True, color='000000', size=12)
    ws['F2'] = 'Unit Price'
    ws['F2'].font = openpyxl.styles.Font(b=True, color='000000', size=12)
    ws['G2'] = 'Total Price'
    ws['G2'].font = openpyxl.styles.Font(b=True, color='000000', size=12)


## 칼럼별 너비 조정 구간
#    for col in range(ws.max_column):
#        ws.column_dimensions[chr(ord('A') + col)].width = 15
    ws.column_dimensions['A'].width = 15
    ws.column_dimensions['B'].width = 45
    ws.column_dimensions['C'].width = 60
    ws.column_dimensions['D'].width = 20
    ws.column_dimensions['E'].width = 20
    ws.column_dimensions['F'].width = 20
    ws.column_dimensions['G'].width = 20
    #ws.column_dimensions['G'].width = 9
    #ws.column_dimensions['H'].width = 9
    #ws.column_dimensions['H'].hidden = True
    #ws.column_dimensions['I'].width = 12
    #ws.column_dimensions['I'].hidden = True
    #ws.column_dimensions['J'].width = 12
    #ws.column_dimensions['K'].width = 12
    #ws.column_dimensions['L'].width = 12

###
    start_row = 3
    for (row, item) in enumerate(sample_items, start_row):
        cell = ws.cell(row=row, column=1, value=row - 2)
        cell.alignment = openpyxl.styles.Alignment(horizontal='center', vertical='center')

#        cell = ws.cell(row=row, column=2, value=item[0])
#        cell.number_format = openpyxl.styles.numbers.FORMAT_DATE_YYYYMMDD2  # 'yyyy-mm-dd'
        ws.cell(row=row, column=2, value=item[0]) ## Family Type 칼럼

        ws.cell(row=row, column=3, value=item[1]) ## WorkMaster Code 칼럼
        
        ws.cell(row=row, column=4, value=item[2]) ## Quantities 칼럼
        
        ws.cell(row=row, column=5, value=item[3]) ## Unit 칼럼
        
        #cell = ws.cell(row=row, column=8, value=item[6]) ## 계수 칼럼
        #cell.number_format = openpyxl.styles.numbers.builtin_format_code(3)  # '#,##0'
        
        #cell = ws.cell(row=row, column=9, value=item[7]) ## 계산 참조값 칼럼
        #cell.number_format = openpyxl.styles.numbers.builtin_format_code(3)  # '#,##0'
        
        #cell = ws.cell(row=row, column=10, value=item[8]) ## Quantities 칼럼
        #cell.number_format = openpyxl.styles.numbers.builtin_format_code(3)  # '#,##0'
        #cell.font = openpyxl.styles.Font(b=True, color='000000', size=11)

        cell = ws.cell(row=row, column=7, value='= D{current_row}*F{current_row}'.format(current_row=cell.row))
        cell.number_format = '#,##0'

#        cell = ws.cell(row=row, column=6, value='= D{current_row} * E{current_row}'.format(current_row=cell.row))
#        cell.number_format = openpyxl.styles.numbers.builtin_format_code(3)

    total_row = ws.max_row + 1
    if total_row > start_row:
        cell1 = ws.cell(row=total_row, column=6, value='Total')
        cell1.font = openpyxl.styles.Font(b=True, color='000000', size=15)
        
        cell2 = ws.cell(row=total_row, column=7, value='= SUM(G{}:G{})'.format(start_row, total_row - 1))
        cell2.number_format = openpyxl.styles.numbers.builtin_format_code(3)
        cell2.border = Border(top=double, left=double, right=double, bottom=double)
        cell2.font = openpyxl.styles.Font(b=True, color='ff03ce', size=15)
    

    wb.save(filepath)
    wb.close()


##if __name__ == '__main__':
#write_to_file('C:\\Users\\pjmk0\\AppData\\Roaming\\test.xlsx')

save_name = "HecStrFramingCalcSheet_" + Today.strftime("%Y-%m-%d")+".xlsx"
path = os.getenv('APPDATA').replace('\\','\\\\')
filePath = path + '\\' + save_name

write_to_file(filePath)

# Assign your output to the OUT variable.
OUT = os.getenv('APPDATA')
# ----------------------------------------

# group: Preview
geometry_2 = Element.Geometry(element=filterByBoolMask_2.in)
watch_30 = Watch(geometry_2)

# group: Primary Input
categories_2 = Categories("OST_StructuralFraming")
all_elements_of_category_2 = ElementsOfCategory(Category=categories_2)
file_path_2 = Filename(".\BIM_물량집계 자동화 산출기준표_rC(20210713)_KCS.xlsx")
file_from_path_2 = FileObject(path=file_path_2)
code_block_44 = CodeBlock { "Scope_lv2(Str Framing)"; }

# group: GetFull WMCodeDescription PerElement
getFullWMCodeDescriptionPerElement = Custom[GetFullWMCodeDescriptionPerElement](InputElement=all_elements_of_category_2, InputFilePath=file_from_path_2, InputSheetName=code_block_44)  # GetFullWMCodeDescriptionPerElement

# group: OrganizeAllElementInformAsDictionary
organizeAllElementInformAsDictionary = Custom[OrganizeAllElementInformAsDictionary](InputDic=getFullWMCodeDescriptionPerElement.Dictionary)  # OrganizeAllElementInformAsDictionary

# group: Select Target Family Element And Connected WorkMasters
code_block_45 = CodeBlock { 0; }
selectTargetFamilyInformAsDictionary = Custom[SelectTargetFamilyInformAsDictionary](InputDic=organizeAllElementInformAsDictionary, InputIndex=code_block_45)  # Select Target Family Element And Connected WorkMasters

# group: Distributer
code_block_46 = CodeBlock(i=selectTargetFamilyInformAsDictionary) { i; }
code_block_47 = CodeBlock(i=code_block_46) { i; }
code_block_48 = CodeBlock(i=code_block_47) { i; }
code_block_49 = CodeBlock(i=code_block_47) { i; }
code_block_50 = CodeBlock(i=code_block_47) { i; }
code_block_51 = CodeBlock(i=code_block_46) { i; }
code_block_52 = CodeBlock(i=code_block_51) { i; }
code_block_53 = CodeBlock(i=code_block_51) { i; }
code_block_54 = CodeBlock(i=code_block_47) { i; }
code_block_55 = CodeBlock(i=code_block_51) { i; }
code_block_56 = CodeBlock(i=code_block_51) { i; }

code_block_57 = CodeBlock { "TargetElements"; }
valueAtKey_2 = DesignScript.Builtin.Dictionary.ValueAtKey(dictionary=code_block_48, key=code_block_57)
# note: <Func>
createBaseCourseSurfaces = Custom[CreateBaseCourseSurfaces](Element=valueAtKey_2)  # CreateBaseCourseSurfaces
code_block_58 = CodeBlock { "TargetElements"; }
valueAtKey_3 = DesignScript.Builtin.Dictionary.ValueAtKey(dictionary=code_block_49, key=code_block_58)
createExcavationSolid = Custom[CreateExcavationSolid](Element=valueAtKey_3)  # CreateExcavationSolidForISOFDN
code_block_59 = CodeBlock { "TargetElements"; }
valueAtKey_4 = DesignScript.Builtin.Dictionary.ValueAtKey(dictionary=code_block_50, key=code_block_59)
createLeanConcrete = Custom[CreateLeanConcrete](Element=valueAtKey_4)  # CreateLeanConcreteForISOFDN
code_block_60 = CodeBlock { "TargetElements"; }
valueAtKey_5 = DesignScript.Builtin.Dictionary.ValueAtKey(dictionary=code_block_52, key=code_block_60)
extractSideFacesOfElement = Custom[ExtractSideFacesOfElement](Element=valueAtKey_5)  # ExtractSideFacesOfElement
code_block_61 = CodeBlock { "TargetElements"; }
valueAtKey_6 = DesignScript.Builtin.Dictionary.ValueAtKey(dictionary=code_block_53, key=code_block_61)
code_block_62 = CodeBlock(Element=valueAtKey_6) { _Element; }
extractUpperFacesOfElement = Custom[ExtractUpperFacesOfElement](Element=code_block_62)  # ExtractUpperFacesOfElement
flatten_9 = List.Flatten(list=extractUpperFacesOfElement.Surface)
getJoinedElements = Element.GetJoinedElements(element=code_block_62)
flatten_10 = List.Flatten(list=getJoinedElements)
extractBelowFacesOfElement = Custom[ExtractBelowFacesOfElement](Element=flatten_10)  # ExtractBelowFacesOfElement
flatten_11 = List.Flatten(list=extractBelowFacesOfElement.Surface)
doesIntersect = Geometry.DoesIntersect(geometry=flatten_11, other=flatten_9, lacing=CrossProduct)
code_block_63 = CodeBlock { true; }
allIndicesOf_6 = List.AllIndicesOf(list=doesIntersect@L2, item=code_block_63)
flatten_12 = List.Flatten(list=allIndicesOf_6)
groupByKey = List.GroupByKey(list=flatten_11, keys=flatten_12)
difference = Surface.Difference(surface=flatten_9, others=groupByKey.groups)
extractSideFacesOfElement_2 = Custom[ExtractSideFacesOfElement](Element=code_block_62)
addItemToFront = List.AddItemToFront(item=difference@L1, list=extractSideFacesOfElement_2.Surface@L2)
color_palette = ColorPalette({R: 30, G: 144, B: 255, A: 129})
byGeometryColor = Modifiers.GeometryColor.ByGeometryColor(geometry=addItemToFront, color=color_palette)

# group: See Result
code_block_64 = CodeBlock(SeeResult=createBaseCourseSurfaces.GeometryColor) { SeeResult; }
code_block_65 = CodeBlock(SeeResult=createExcavationSolid.GeometryColor) { SeeResult; }
code_block_66 = CodeBlock(SeeResult=createLeanConcrete.GeometryColor) { SeeResult; }
code_block_67 = CodeBlock(SeeResult=extractSideFacesOfElement.GeometryColor) { SeeResult; }
code_block_68 = CodeBlock(SeeResult=byGeometryColor) { SeeResult; }

# group: Select Target Family Element And Connected WorkMasters
code_block_69 = CodeBlock { 1; }
selectTargetFamilyInformAsDictionary_2 = Custom[SelectTargetFamilyInformAsDictionary](InputDic=organizeAllElementInformAsDictionary, InputIndex=code_block_69)

# group: Distributer
code_block_70 = CodeBlock(i=selectTargetFamilyInformAsDictionary_2) { i; }
code_block_71 = CodeBlock(i=code_block_70) { i; }
code_block_72 = CodeBlock(i=code_block_71) { i; }
code_block_73 = CodeBlock(i=code_block_71) { i; }
code_block_74 = CodeBlock(i=code_block_70) { i; }
code_block_75 = CodeBlock(i=code_block_74) { i; }
code_block_76 = CodeBlock(i=code_block_70) { i; }
code_block_77 = CodeBlock(i=code_block_76) { i; }
code_block_78 = CodeBlock(i=code_block_70) { i; }
code_block_79 = CodeBlock(i=code_block_78) { i; }
code_block_80 = CodeBlock(i=code_block_71) { i; }
code_block_81 = CodeBlock(i=code_block_76) { i; }
code_block_82 = CodeBlock(i=code_block_76) { i; }
code_block_83 = CodeBlock(i=code_block_78) { i; }
code_block_84 = CodeBlock(i=code_block_78) { i; }
code_block_85 = CodeBlock(i=code_block_74) { i; }

code_block_86 = CodeBlock { "TargetElements"; }
valueAtKey_7 = DesignScript.Builtin.Dictionary.ValueAtKey(dictionary=code_block_72, key=code_block_86)
extractUpperFacesOfElement_2 = Custom[ExtractUpperFacesOfElement](Element=valueAtKey_7)

# group: <Func 2> - 수정필요
code_block_87 = CodeBlock { "TargetElements"; }
valueAtKey_8 = DesignScript.Builtin.Dictionary.ValueAtKey(dictionary=code_block_73, key=code_block_87)
# note: <Func>
extractSideFacesOfElement_3 = Custom[ExtractSideFacesOfElement](Element=valueAtKey_8)
area = Surface.Area(surface=extractSideFacesOfElement_3.Surface)
sum = Math.Sum(values=area)
code_block_88 = CodeBlock(i=sum) { Math.Round(List.Flatten(i)/1000000, 2); }
code_block_89 = CodeBlock { "M2"; }
count_6 = List.Count(list=code_block_88)
ofRepeatedItem_2 = List.OfRepeatedItem(item=code_block_89, amount=count_6)
code_block_90 = CodeBlock(FuncValues=code_block_88, FuncValuesUnit=ofRepeatedItem_2)
# ---------- code_block_90.designscript (4 lines) ----------
{
"FuncValues": _FuncValues,
"FuncValuesUnit": _FuncValuesUnit
};
# ----------------------------------------

code_block_91 = CodeBlock { "TargetElements"; }
valueAtKey_9 = DesignScript.Builtin.Dictionary.ValueAtKey(dictionary=code_block_75, key=code_block_91)
code_block_92 = CodeBlock { 0; 100; }
createLeanConcrete_2 = Custom[CreateLeanConcrete](Element=valueAtKey_9, leanOffset=code_block_92.out0, leanThick=code_block_92.out1)
code_block_93 = CodeBlock { "TargetElements"; }
valueAtKey_10 = DesignScript.Builtin.Dictionary.ValueAtKey(dictionary=code_block_77, key=code_block_93)
code_block_94 = CodeBlock { 0; }
createExcavationSolid_2 = Custom[CreateExcavationSolid](Element=valueAtKey_10, ExcavOffsetTop=code_block_94, ExcavOffsetBottom=code_block_94)
code_block_95 = CodeBlock { "TargetElements"; }
valueAtKey_11 = DesignScript.Builtin.Dictionary.ValueAtKey(dictionary=code_block_79, key=code_block_95)
createBaseCourseSurfaces_2 = Custom[CreateBaseCourseSurfaces](Element=valueAtKey_11)

# group: See Result
code_block_96 = CodeBlock(SeeResult=extractUpperFacesOfElement_2.GeometryColor) { SeeResult; }
code_block_97 = CodeBlock(SeeResult=extractSideFacesOfElement_3.GeometryColor) { SeeResult; }
code_block_98 = CodeBlock(SeeResult=createLeanConcrete_2.GeometryColor) { SeeResult; }
code_block_99 = CodeBlock(SeeResult=createExcavationSolid_2.GeometryColor) { SeeResult; }
code_block_100 = CodeBlock(SeeResult=createBaseCourseSurfaces_2.GeometryColor) { SeeResult; }

# group: Select Target Family Element And Connected WorkMasters
code_block_101 = CodeBlock { 2; }
selectTargetFamilyInformAsDictionary_3 = Custom[SelectTargetFamilyInformAsDictionary](InputDic=organizeAllElementInformAsDictionary, InputIndex=code_block_101)

# group: Distributer
code_block_102 = CodeBlock(i=selectTargetFamilyInformAsDictionary_3) { i; }
code_block_103 = CodeBlock(i=code_block_102) { i; }
code_block_104 = CodeBlock(i=code_block_103) { i; }
code_block_105 = CodeBlock(i=code_block_103) { i; }
code_block_106 = CodeBlock(i=code_block_102) { i; }
code_block_107 = CodeBlock(i=code_block_106) { i; }
code_block_108 = CodeBlock(i=code_block_102) { i; }
code_block_109 = CodeBlock(i=code_block_108) { i; }
code_block_110 = CodeBlock(i=code_block_102) { i; }
code_block_111 = CodeBlock(i=code_block_110) { i; }
code_block_112 = CodeBlock(i=code_block_103) { i; }
code_block_113 = CodeBlock(i=code_block_106) { i; }
code_block_114 = CodeBlock(i=code_block_106) { i; }
code_block_115 = CodeBlock(i=code_block_108) { i; }
code_block_116 = CodeBlock(i=code_block_108) { i; }
code_block_117 = CodeBlock(i=code_block_110) { i; }

code_block_118 = CodeBlock { "TargetElements"; }
valueAtKey_12 = DesignScript.Builtin.Dictionary.ValueAtKey(dictionary=code_block_104, key=code_block_118)
extractUpperFacesOfElement_3 = Custom[ExtractUpperFacesOfElement](Element=valueAtKey_12)

# group: <Func 2> - 수정필요
code_block_119 = CodeBlock { "TargetElements"; }
valueAtKey_13 = DesignScript.Builtin.Dictionary.ValueAtKey(dictionary=code_block_105, key=code_block_119)
# note: <Func>
extractSideFacesOfElement_4 = Custom[ExtractSideFacesOfElement](Element=valueAtKey_13)
area_2 = Surface.Area(surface=extractSideFacesOfElement_4.Surface)
sum_2 = Math.Sum(values=area_2)
code_block_120 = CodeBlock(i=sum_2) { Math.Round(List.Flatten(i)/1000000, 2); }
code_block_121 = CodeBlock { "M2"; }
count_7 = List.Count(list=code_block_120)
ofRepeatedItem_3 = List.OfRepeatedItem(item=code_block_121, amount=count_7)
code_block_122 = CodeBlock(FuncValues=code_block_120, FuncValuesUnit=ofRepeatedItem_3)  # same code as code_block_90

code_block_123 = CodeBlock { "TargetElements"; }
valueAtKey_14 = DesignScript.Builtin.Dictionary.ValueAtKey(dictionary=code_block_107, key=code_block_123)
code_block_124 = CodeBlock { 0; }
createExcavationSolid_3 = Custom[CreateExcavationSolid](Element=valueAtKey_14, ExcavOffsetTop=code_block_124, ExcavOffsetBottom=code_block_124)
code_block_125 = CodeBlock { "TargetElements"; }
valueAtKey_15 = DesignScript.Builtin.Dictionary.ValueAtKey(dictionary=code_block_109, key=code_block_125)
createBaseCourseSurfaces_3 = Custom[CreateBaseCourseSurfaces](Element=valueAtKey_15)
code_block_126 = CodeBlock { "TargetElements"; }
valueAtKey_16 = DesignScript.Builtin.Dictionary.ValueAtKey(dictionary=code_block_111, key=code_block_126)
code_block_127 = CodeBlock { 0; 100; }
createLeanConcrete_3 = Custom[CreateLeanConcrete](Element=valueAtKey_16, leanOffset=code_block_127.out0, leanThick=code_block_127.out1)

# group: See Result
code_block_128 = CodeBlock(SeeResult=extractUpperFacesOfElement_3.GeometryColor) { SeeResult; }
code_block_129 = CodeBlock(SeeResult=extractSideFacesOfElement_4.GeometryColor) { SeeResult; }
code_block_130 = CodeBlock(SeeResult=createExcavationSolid_3.GeometryColor) { SeeResult; }
code_block_131 = CodeBlock(SeeResult=createBaseCourseSurfaces_3.GeometryColor) { SeeResult; }
code_block_132 = CodeBlock(SeeResult=createLeanConcrete_3.GeometryColor) { SeeResult; }

code_block_133 = CodeBlock { "TargetElements"; }
valueAtKey_17 = DesignScript.Builtin.Dictionary.ValueAtKey(dictionary=code_block_54, key=code_block_133)
code_block_134 = CodeBlock { "Volume"; }
getParameterValueByName_6 = Element.GetParameterValueByName(element=valueAtKey_17, parameterName=code_block_134)
code_block_135 = CodeBlock(i=getParameterValueByName_6) { Math.Round(List.Flatten(i)/1, 2); }
code_block_136 = CodeBlock { "M3"; }
count_8 = List.Count(list=code_block_135)
ofRepeatedItem_4 = List.OfRepeatedItem(item=code_block_136, amount=count_8)
code_block_137 = CodeBlock(FuncValues=code_block_135, FuncValuesUnit=ofRepeatedItem_4)  # same code as code_block_90
volume = Solid.Volume(solid=createExcavationSolid.Solid)
code_block_138 = CodeBlock(i=volume) { Math.Round(List.Flatten(i)/1000000000, 2); }
code_block_139 = CodeBlock { "M3"; }
count_9 = List.Count(list=code_block_138)
ofRepeatedItem_5 = List.OfRepeatedItem(item=code_block_139, amount=count_9)
code_block_140 = CodeBlock(FuncValues=code_block_138, FuncValuesUnit=ofRepeatedItem_5)  # same code as code_block_90
area_3 = Surface.Area(surface=createBaseCourseSurfaces.Surface)
code_block_141 = CodeBlock(i=area_3) { Math.Round(List.Flatten(i)/1000000, 2); }
code_block_142 = CodeBlock { "M2"; }
count_10 = List.Count(list=code_block_141)
ofRepeatedItem_6 = List.OfRepeatedItem(item=code_block_142, amount=count_10)
code_block_143 = CodeBlock(FuncValues=code_block_141, FuncValuesUnit=ofRepeatedItem_6)  # same code as code_block_90
volume_2 = Solid.Volume(solid=createLeanConcrete.Solid)
code_block_144 = CodeBlock(i=volume_2) { Math.Round(List.Flatten(i)/1000000000, 2); }
code_block_145 = CodeBlock { "M3"; }
count_11 = List.Count(list=code_block_144)
ofRepeatedItem_7 = List.OfRepeatedItem(item=code_block_145, amount=count_11)
code_block_146 = CodeBlock(FuncValues=code_block_144, FuncValuesUnit=ofRepeatedItem_7)  # same code as code_block_90
area_4 = Surface.Area(surface=extractSideFacesOfElement.Surface)
sum_3 = Math.Sum(values=area_4)
code_block_147 = CodeBlock(i=sum_3) { Math.Round(List.Flatten(i)/1000000, 2); }
code_block_148 = CodeBlock { "M2"; }
count_12 = List.Count(list=code_block_147)
ofRepeatedItem_8 = List.OfRepeatedItem(item=code_block_148, amount=count_12)
code_block_149 = CodeBlock(FuncValues=code_block_147, FuncValuesUnit=ofRepeatedItem_8)  # same code as code_block_90
code_block_150 = CodeBlock { "TargetElements"; }
valueAtKey_18 = DesignScript.Builtin.Dictionary.ValueAtKey(dictionary=code_block_55, key=code_block_150)
code_block_151 = CodeBlock { "Volume"; }
getParameterValueByName_7 = Element.GetParameterValueByName(element=valueAtKey_18, parameterName=code_block_151)
code_block_152 = CodeBlock { 0.1; }
mul_3 = getParameterValueByName_7 * code_block_152
code_block_153 = CodeBlock(i=mul_3) { Math.Round(List.Flatten(i)/1, 2); }
code_block_154 = CodeBlock { "TON"; }
count_13 = List.Count(list=code_block_153)
ofRepeatedItem_9 = List.OfRepeatedItem(item=code_block_154, amount=count_13)
code_block_155 = CodeBlock(FuncValues=code_block_153, FuncValuesUnit=ofRepeatedItem_9)  # same code as code_block_90
code_block_156 = CodeBlock { "TargetElements"; }
valueAtKey_19 = DesignScript.Builtin.Dictionary.ValueAtKey(dictionary=code_block_56, key=code_block_156)
createLeanConcrete_4 = Custom[CreateLeanConcrete](Element=valueAtKey_19)
area_5 = Surface.Area(surface=createLeanConcrete_4.Surface)
code_block_157 = CodeBlock(i=area_5) { Math.Round(List.Flatten(i)/1000000, 2); }
code_block_158 = CodeBlock { "M2"; }
count_14 = List.Count(list=code_block_157)
ofRepeatedItem_10 = List.OfRepeatedItem(item=code_block_158, amount=count_14)
code_block_159 = CodeBlock(FuncValues=code_block_157, FuncValuesUnit=ofRepeatedItem_10)  # same code as code_block_90
area_6 = Surface.Area(surface=addItemToFront)
sum_4 = Math.Sum(values=area_6)
code_block_160 = CodeBlock(i=sum_4) { Math.Round(List.Flatten(i)/1000000, 2); }
code_block_161 = CodeBlock { "M2"; }
count_15 = List.Count(list=code_block_160)
ofRepeatedItem_11 = List.OfRepeatedItem(item=code_block_161, amount=count_15)
code_block_162 = CodeBlock(FuncValues=code_block_160, FuncValuesUnit=ofRepeatedItem_11)  # same code as code_block_90
join_2 = List.Join(list0=code_block_137, list1=code_block_140, list2=code_block_143, list3=code_block_146, list4=code_block_149, list5=code_block_155, list6=code_block_159, list7=code_block_162)

# group: TargetWMunique + Data Sending
code_block_163 = CodeBlock(InputDic2=join_2) { _InputDic2; }
count_16 = List.Count(list=code_block_163)
code_block_164 = CodeBlock(InputDic1=code_block_46) { _InputDic1; }
code_block_165 = CodeBlock { "TargetWMunique"; }
valueAtKey_20 = DesignScript.Builtin.Dictionary.ValueAtKey(dictionary=code_block_164, key=code_block_165)
watch_31 = Watch(valueAtKey_20)
count_17 = List.Count(list=watch_31)
eq = count_16 == count_17
organizeFuncValuesAndWorkMasterAsDiction = Custom[OrganizeFuncValuesAndWorkMasterAsDictionary](InputDic1=code_block_164, InputDic2=code_block_163)  # Organize FuncValues and WorkMaster As Dictionary
watch_32 = Watch()  # unwired: arg0
if_ = If(test=eq, true=organizeFuncValuesAndWorkMasterAsDiction, false=watch_32)

# group: 데이터 취합 및 Row 방향 정렬
code_block_166 = CodeBlock(InputDic=if_) { _InputDic; }
code_block_167 = CodeBlock { "TrTargetFamilyCode"; }
valueAtKey_21 = DesignScript.Builtin.Dictionary.ValueAtKey(dictionary=code_block_166, key=code_block_167)
watch_33 = Watch(valueAtKey_21)
flatten_13 = List.Flatten(list=watch_33)
code_block_168 = CodeBlock { "WMforTargetElements"; }
valueAtKey_22 = DesignScript.Builtin.Dictionary.ValueAtKey(dictionary=code_block_166, key=code_block_168)
watch_34 = Watch(valueAtKey_22)
flatten_14 = List.Flatten(list=watch_34)
code_block_169 = CodeBlock { "TargetFuncValues"; }
valueAtKey_23 = DesignScript.Builtin.Dictionary.ValueAtKey(dictionary=code_block_166, key=code_block_169)
watch_35 = Watch(valueAtKey_23)
flatten_15 = List.Flatten(list=watch_35)
code_block_170 = CodeBlock { "TargetFuncValuesUnit"; }
valueAtKey_24 = DesignScript.Builtin.Dictionary.ValueAtKey(dictionary=code_block_166, key=code_block_170)
watch_36 = Watch(valueAtKey_24)
flatten_16 = List.Flatten(list=watch_36)
list_create_4 = List.Create(item0=flatten_13, item1=flatten_14, item2=flatten_15, item3=flatten_16)
transpose_3 = List.Transpose(lists=list_create_4)

area_7 = Surface.Area(surface=extractUpperFacesOfElement_2.Surface)
sum_5 = Math.Sum(values=area_7)
code_block_171 = CodeBlock(i=sum_5) { Math.Round(List.Flatten(i)/1000000, 2); }
code_block_172 = CodeBlock { "M3"; }
count_18 = List.Count(list=code_block_171)
ofRepeatedItem_12 = List.OfRepeatedItem(item=code_block_172, amount=count_18)
code_block_173 = CodeBlock(FuncValues=code_block_171, FuncValuesUnit=ofRepeatedItem_12)  # same code as code_block_90
code_block_174 = CodeBlock { "TargetElements"; }
valueAtKey_25 = DesignScript.Builtin.Dictionary.ValueAtKey(dictionary=code_block_80, key=code_block_174)
code_block_175 = CodeBlock { "Volume"; }
getParameterValueByName_8 = Element.GetParameterValueByName(element=valueAtKey_25, parameterName=code_block_175)
code_block_176 = CodeBlock(i=getParameterValueByName_8) { Math.Round(List.Flatten(i)/1000000, 2); }
code_block_177 = CodeBlock { "M3"; }
count_19 = List.Count(list=code_block_176)
ofRepeatedItem_13 = List.OfRepeatedItem(item=code_block_177, amount=count_19)
code_block_178 = CodeBlock(FuncValues=code_block_176, FuncValuesUnit=ofRepeatedItem_13)  # same code as code_block_90
code_block_179 = CodeBlock { "TargetElements"; }
valueAtKey_26 = DesignScript.Builtin.Dictionary.ValueAtKey(dictionary=code_block_81, key=code_block_179)
createLeanConcrete_5 = Custom[CreateLeanConcrete](Element=valueAtKey_26)
area_8 = Surface.Area(surface=createLeanConcrete_5.Surface)
code_block_180 = CodeBlock(i=area_8) { Math.Round(List.Flatten(i)/1000000, 2); }
code_block_181 = CodeBlock { "M2"; }
count_20 = List.Count(list=code_block_180)
ofRepeatedItem_14 = List.OfRepeatedItem(item=code_block_181, amount=count_20)
code_block_182 = CodeBlock(FuncValues=code_block_180, FuncValuesUnit=ofRepeatedItem_14)  # same code as code_block_90
map_2 = List.Map()  # unwired: list, function
isNull = Object.IsNull(object=createExcavationSolid_2.Solid)
code_block_183 = CodeBlock { 1; }
mul_4 = _ * code_block_183  # unwired: x
volume_3 = Solid.Volume()  # unwired: solid
if_2 = If(test=isNull, true=mul_4, false=volume_3)
code_block_184 = CodeBlock { 0; }
isNull_2 = Object.IsNull()  # unwired: object
replaceByCondition = Replace(item=createExcavationSolid_2.Solid, replaceWith=code_block_184, condition=isNull_2)
laceShortest_2 = List.LaceShortest(combineFunction=map_2, list0=if_2, list1=replaceByCondition)
code_block_185 = CodeBlock(i=laceShortest_2) { Math.Round(List.Flatten(i)/1000000000, 2); }
code_block_186 = CodeBlock { "M3"; }
count_21 = List.Count(list=code_block_185)
ofRepeatedItem_15 = List.OfRepeatedItem(item=code_block_186, amount=count_21)
code_block_187 = CodeBlock(FuncValues=code_block_185, FuncValuesUnit=ofRepeatedItem_15)  # same code as code_block_90
code_block_188 = CodeBlock { 0; }
code_block_189 = CodeBlock { "TargetElements"; }
valueAtKey_27 = DesignScript.Builtin.Dictionary.ValueAtKey(dictionary=code_block_82, key=code_block_189)
count_22 = List.Count(list=valueAtKey_27@L1)
ofRepeatedItem_16 = List.OfRepeatedItem(item=code_block_188, amount=count_22)
code_block_190 = CodeBlock(i=ofRepeatedItem_16) { Math.Round(List.Flatten(i)/1000000000, 2); }
code_block_191 = CodeBlock { "M3"; }
count_23 = List.Count(list=code_block_190)
ofRepeatedItem_17 = List.OfRepeatedItem(item=code_block_191, amount=count_23)
code_block_192 = CodeBlock(FuncValues=code_block_190, FuncValuesUnit=ofRepeatedItem_17)  # same code as code_block_90
code_block_193 = CodeBlock { 0; }
code_block_194 = CodeBlock { "TargetElements"; }
valueAtKey_28 = DesignScript.Builtin.Dictionary.ValueAtKey(dictionary=code_block_83, key=code_block_194)
count_24 = List.Count(list=valueAtKey_28@L1)
ofRepeatedItem_18 = List.OfRepeatedItem(item=code_block_193, amount=count_24)
code_block_195 = CodeBlock(i=ofRepeatedItem_18) { Math.Round(List.Flatten(i)/1000000000, 2); }
code_block_196 = CodeBlock { "M3"; }
count_25 = List.Count(list=code_block_195)
ofRepeatedItem_19 = List.OfRepeatedItem(item=code_block_196, amount=count_25)
code_block_197 = CodeBlock(FuncValues=code_block_195, FuncValuesUnit=ofRepeatedItem_19)  # same code as code_block_90
area_9 = Surface.Area(surface=createBaseCourseSurfaces_2.Surface)
code_block_198 = CodeBlock(i=area_9) { Math.Round(List.Flatten(i)/1000000, 2); }
code_block_199 = CodeBlock { "M2"; }
count_26 = List.Count(list=code_block_198)
ofRepeatedItem_20 = List.OfRepeatedItem(item=code_block_199, amount=count_26)
code_block_200 = CodeBlock(FuncValues=code_block_198, FuncValuesUnit=ofRepeatedItem_20)  # same code as code_block_90
code_block_201 = CodeBlock { 0; }
code_block_202 = CodeBlock { "TargetElements"; }
valueAtKey_29 = DesignScript.Builtin.Dictionary.ValueAtKey(dictionary=code_block_84, key=code_block_202)
count_27 = List.Count(list=valueAtKey_29@L1)
ofRepeatedItem_21 = List.OfRepeatedItem(item=code_block_201, amount=count_27)
code_block_203 = CodeBlock(i=ofRepeatedItem_21) { Math.Round(List.Flatten(i)/1000000000, 2); }
code_block_204 = CodeBlock { "M3"; }
count_28 = List.Count(list=code_block_203)
ofRepeatedItem_22 = List.OfRepeatedItem(item=code_block_204, amount=count_28)
code_block_205 = CodeBlock(FuncValues=code_block_203, FuncValuesUnit=ofRepeatedItem_22)  # same code as code_block_90
volume_4 = Solid.Volume(solid=createLeanConcrete_2.Solid)
code_block_206 = CodeBlock(i=volume_4) { Math.Round(List.Flatten(i)/1000000000, 2); }
code_block_207 = CodeBlock { "M3"; }
count_29 = List.Count(list=code_block_206)
ofRepeatedItem_23 = List.OfRepeatedItem(item=code_block_207, amount=count_29)
code_block_208 = CodeBlock(FuncValues=code_block_206, FuncValuesUnit=ofRepeatedItem_23)  # same code as code_block_90
code_block_209 = CodeBlock { "TargetElements"; }
valueAtKey_30 = DesignScript.Builtin.Dictionary.ValueAtKey(dictionary=code_block_85, key=code_block_209)
code_block_210 = CodeBlock { "Volume"; }
getParameterValueByName_9 = Element.GetParameterValueByName(element=valueAtKey_30, parameterName=code_block_210)
code_block_211 = CodeBlock { 0.1; }
mul_5 = getParameterValueByName_9 * code_block_211
code_block_212 = CodeBlock(i=mul_5) { Math.Round(List.Flatten(i)/1, 2); }
code_block_213 = CodeBlock { "TON"; }
count_30 = List.Count(list=code_block_212)
ofRepeatedItem_24 = List.OfRepeatedItem(item=code_block_213, amount=count_30)
code_block_214 = CodeBlock(FuncValues=code_block_212, FuncValuesUnit=ofRepeatedItem_24)  # same code as code_block_90
join_3 = List.Join(list0=code_block_173, list1=code_block_178, list2=code_block_90, list3=code_block_182, list4=code_block_187, list5=code_block_192, list6=code_block_197, list7=code_block_200, list8=code_block_205, list9=code_block_208, list10=code_block_214)

# group: TargetWMunique + Data Sending
code_block_215 = CodeBlock(InputDic2=join_3) { _InputDic2; }
count_31 = List.Count(list=code_block_215)
code_block_216 = CodeBlock(InputDic1=code_block_70) { _InputDic1; }
code_block_217 = CodeBlock { "TargetWMunique"; }
valueAtKey_31 = DesignScript.Builtin.Dictionary.ValueAtKey(dictionary=code_block_216, key=code_block_217)
watch_37 = Watch(valueAtKey_31)
count_32 = List.Count(list=watch_37)
eq_2 = count_31 == count_32
organizeFuncValuesAndWorkMasterAsDiction_2 = Custom[OrganizeFuncValuesAndWorkMasterAsDictionary](InputDic1=code_block_216, InputDic2=code_block_215)
watch_38 = Watch()  # unwired: arg0
if_3 = If(test=eq_2, true=organizeFuncValuesAndWorkMasterAsDiction_2, false=watch_38)

# group: 데이터 취합 및 Row 방향 정렬
code_block_218 = CodeBlock(InputDic=if_3) { _InputDic; }
code_block_219 = CodeBlock { "TrTargetFamilyCode"; }
valueAtKey_32 = DesignScript.Builtin.Dictionary.ValueAtKey(dictionary=code_block_218, key=code_block_219)
watch_39 = Watch(valueAtKey_32)
flatten_17 = List.Flatten(list=watch_39)
code_block_220 = CodeBlock { "WMforTargetElements"; }
valueAtKey_33 = DesignScript.Builtin.Dictionary.ValueAtKey(dictionary=code_block_218, key=code_block_220)
watch_40 = Watch(valueAtKey_33)
flatten_18 = List.Flatten(list=watch_40)
code_block_221 = CodeBlock { "TargetFuncValues"; }
valueAtKey_34 = DesignScript.Builtin.Dictionary.ValueAtKey(dictionary=code_block_218, key=code_block_221)
watch_41 = Watch(valueAtKey_34)
flatten_19 = List.Flatten(list=watch_41)
code_block_222 = CodeBlock { "TargetFuncValuesUnit"; }
valueAtKey_35 = DesignScript.Builtin.Dictionary.ValueAtKey(dictionary=code_block_218, key=code_block_222)
watch_42 = Watch(valueAtKey_35)
flatten_20 = List.Flatten(list=watch_42)
list_create_5 = List.Create(item0=flatten_17, item1=flatten_18, item2=flatten_19, item3=flatten_20)
transpose_4 = List.Transpose(lists=list_create_5)

area_10 = Surface.Area(surface=extractUpperFacesOfElement_3.Surface)
sum_6 = Math.Sum(values=area_10)
code_block_223 = CodeBlock(i=sum_6) { Math.Round(List.Flatten(i)/1000000, 2); }
code_block_224 = CodeBlock { "M3"; }
count_33 = List.Count(list=code_block_223)
ofRepeatedItem_25 = List.OfRepeatedItem(item=code_block_224, amount=count_33)
code_block_225 = CodeBlock(FuncValues=code_block_223, FuncValuesUnit=ofRepeatedItem_25)  # same code as code_block_90
code_block_226 = CodeBlock { "TargetElements"; }
valueAtKey_36 = DesignScript.Builtin.Dictionary.ValueAtKey(dictionary=code_block_112, key=code_block_226)
code_block_227 = CodeBlock { "Volume"; }
getParameterValueByName_10 = Element.GetParameterValueByName(element=valueAtKey_36, parameterName=code_block_227)
code_block_228 = CodeBlock(i=getParameterValueByName_10) { Math.Round(List.Flatten(i)/1000000, 2); }
code_block_229 = CodeBlock { "M3"; }
count_34 = List.Count(list=code_block_228)
ofRepeatedItem_26 = List.OfRepeatedItem(item=code_block_229, amount=count_34)
code_block_230 = CodeBlock(FuncValues=code_block_228, FuncValuesUnit=ofRepeatedItem_26)  # same code as code_block_90
code_block_231 = CodeBlock { "TargetElements"; }
valueAtKey_37 = DesignScript.Builtin.Dictionary.ValueAtKey(dictionary=code_block_113, key=code_block_231)
createLeanConcrete_6 = Custom[CreateLeanConcrete](Element=valueAtKey_37)
area_11 = Surface.Area(surface=createLeanConcrete_6.Surface)
code_block_232 = CodeBlock(i=area_11) { Math.Round(List.Flatten(i)/1000000, 2); }
code_block_233 = CodeBlock { "M2"; }
count_35 = List.Count(list=code_block_232)
ofRepeatedItem_27 = List.OfRepeatedItem(item=code_block_233, amount=count_35)
code_block_234 = CodeBlock(FuncValues=code_block_232, FuncValuesUnit=ofRepeatedItem_27)  # same code as code_block_90
map_3 = List.Map()  # unwired: list, function
isNull_3 = Object.IsNull(object=createExcavationSolid_3.Solid)
code_block_235 = CodeBlock { 1; }
mul_6 = _ * code_block_235  # unwired: x
volume_5 = Solid.Volume()  # unwired: solid
if_4 = If(test=isNull_3, true=mul_6, false=volume_5)
code_block_236 = CodeBlock { 0; }
isNull_4 = Object.IsNull()  # unwired: object
replaceByCondition_2 = Replace(item=createExcavationSolid_3.Solid, replaceWith=code_block_236, condition=isNull_4)
laceShortest_3 = List.LaceShortest(combineFunction=map_3, list0=if_4, list1=replaceByCondition_2)
code_block_237 = CodeBlock(i=laceShortest_3) { Math.Round(List.Flatten(i)/1000000000, 2); }
code_block_238 = CodeBlock { "M3"; }
count_36 = List.Count(list=code_block_237)
ofRepeatedItem_28 = List.OfRepeatedItem(item=code_block_238, amount=count_36)
code_block_239 = CodeBlock(FuncValues=code_block_237, FuncValuesUnit=ofRepeatedItem_28)  # same code as code_block_90
code_block_240 = CodeBlock { 0; }
code_block_241 = CodeBlock { "TargetElements"; }
valueAtKey_38 = DesignScript.Builtin.Dictionary.ValueAtKey(dictionary=code_block_114, key=code_block_241)
count_37 = List.Count(list=valueAtKey_38@L1)
ofRepeatedItem_29 = List.OfRepeatedItem(item=code_block_240, amount=count_37)
code_block_242 = CodeBlock(i=ofRepeatedItem_29) { Math.Round(List.Flatten(i)/1000000000, 2); }
code_block_243 = CodeBlock { "M3"; }
count_38 = List.Count(list=code_block_242)
ofRepeatedItem_30 = List.OfRepeatedItem(item=code_block_243, amount=count_38)
code_block_244 = CodeBlock(FuncValues=code_block_242, FuncValuesUnit=ofRepeatedItem_30)  # same code as code_block_90
code_block_245 = CodeBlock { 0; }
code_block_246 = CodeBlock { "TargetElements"; }
valueAtKey_39 = DesignScript.Builtin.Dictionary.ValueAtKey(dictionary=code_block_115, key=code_block_246)
count_39 = List.Count(list=valueAtKey_39@L1)
ofRepeatedItem_31 = List.OfRepeatedItem(item=code_block_245, amount=count_39)
code_block_247 = CodeBlock(i=ofRepeatedItem_31) { Math.Round(List.Flatten(i)/1000000000, 2); }
code_block_248 = CodeBlock { "M3"; }
count_40 = List.Count(list=code_block_247)
ofRepeatedItem_32 = List.OfRepeatedItem(item=code_block_248, amount=count_40)
code_block_249 = CodeBlock(FuncValues=code_block_247, FuncValuesUnit=ofRepeatedItem_32)  # same code as code_block_90
area_12 = Surface.Area(surface=createBaseCourseSurfaces_3.Surface)
code_block_250 = CodeBlock(i=area_12) { Math.Round(List.Flatten(i)/1000000, 2); }
code_block_251 = CodeBlock { "M2"; }
count_41 = List.Count(list=code_block_250)
ofRepeatedItem_33 = List.OfRepeatedItem(item=code_block_251, amount=count_41)
code_block_252 = CodeBlock(FuncValues=code_block_250, FuncValuesUnit=ofRepeatedItem_33)  # same code as code_block_90
code_block_253 = CodeBlock { 0; }
code_block_254 = CodeBlock { "TargetElements"; }
valueAtKey_40 = DesignScript.Builtin.Dictionary.ValueAtKey(dictionary=code_block_116, key=code_block_254)
count_42 = List.Count(list=valueAtKey_40@L1)
ofRepeatedItem_34 = List.OfRepeatedItem(item=code_block_253, amount=count_42)
code_block_255 = CodeBlock(i=ofRepeatedItem_34) { Math.Round(List.Flatten(i)/1000000000, 2); }
code_block_256 = CodeBlock { "M3"; }
count_43 = List.Count(list=code_block_255)
ofRepeatedItem_35 = List.OfRepeatedItem(item=code_block_256, amount=count_43)
code_block_257 = CodeBlock(FuncValues=code_block_255, FuncValuesUnit=ofRepeatedItem_35)  # same code as code_block_90
volume_6 = Solid.Volume(solid=createLeanConcrete_3.Solid)
code_block_258 = CodeBlock(i=volume_6) { Math.Round(List.Flatten(i)/1000000000, 2); }
code_block_259 = CodeBlock { "M3"; }
count_44 = List.Count(list=code_block_258)
ofRepeatedItem_36 = List.OfRepeatedItem(item=code_block_259, amount=count_44)
code_block_260 = CodeBlock(FuncValues=code_block_258, FuncValuesUnit=ofRepeatedItem_36)  # same code as code_block_90
code_block_261 = CodeBlock { "TargetElements"; }
valueAtKey_41 = DesignScript.Builtin.Dictionary.ValueAtKey(dictionary=code_block_117, key=code_block_261)
code_block_262 = CodeBlock { "Volume"; }
getParameterValueByName_11 = Element.GetParameterValueByName(element=valueAtKey_41, parameterName=code_block_262)
code_block_263 = CodeBlock { 0.1; }
mul_7 = getParameterValueByName_11 * code_block_263
code_block_264 = CodeBlock(i=mul_7) { Math.Round(List.Flatten(i)/1, 2); }
code_block_265 = CodeBlock { "TON"; }
count_45 = List.Count(list=code_block_264)
ofRepeatedItem_37 = List.OfRepeatedItem(item=code_block_265, amount=count_45)
code_block_266 = CodeBlock(FuncValues=code_block_264, FuncValuesUnit=ofRepeatedItem_37)  # same code as code_block_90
join_4 = List.Join(list0=code_block_225, list1=code_block_230, list2=code_block_122, list3=code_block_234, list4=code_block_239, list5=code_block_244, list6=code_block_249, list7=code_block_252, list8=code_block_257, list9=code_block_260, list10=code_block_266)

# group: TargetWMunique + Data Sending
code_block_267 = CodeBlock(InputDic2=join_4) { _InputDic2; }
count_46 = List.Count(list=code_block_267)
code_block_268 = CodeBlock(InputDic1=code_block_102) { _InputDic1; }
code_block_269 = CodeBlock { "TargetWMunique"; }
valueAtKey_42 = DesignScript.Builtin.Dictionary.ValueAtKey(dictionary=code_block_268, key=code_block_269)
watch_43 = Watch(valueAtKey_42)
count_47 = List.Count(list=watch_43)
eq_3 = count_46 == count_47
organizeFuncValuesAndWorkMasterAsDiction_3 = Custom[OrganizeFuncValuesAndWorkMasterAsDictionary](InputDic1=code_block_268, InputDic2=code_block_267)
watch_44 = Watch()  # unwired: arg0
if_5 = If(test=eq_3, true=organizeFuncValuesAndWorkMasterAsDiction_3, false=watch_44)

# group: 데이터 취합 및 Row 방향 정렬
code_block_270 = CodeBlock(InputDic=if_5) { _InputDic; }
code_block_271 = CodeBlock { "TrTargetFamilyCode"; }
valueAtKey_43 = DesignScript.Builtin.Dictionary.ValueAtKey(dictionary=code_block_270, key=code_block_271)
watch_45 = Watch(valueAtKey_43)
flatten_21 = List.Flatten(list=watch_45)
code_block_272 = CodeBlock { "WMforTargetElements"; }
valueAtKey_44 = DesignScript.Builtin.Dictionary.ValueAtKey(dictionary=code_block_270, key=code_block_272)
watch_46 = Watch(valueAtKey_44)
flatten_22 = List.Flatten(list=watch_46)
code_block_273 = CodeBlock { "TargetFuncValues"; }
valueAtKey_45 = DesignScript.Builtin.Dictionary.ValueAtKey(dictionary=code_block_270, key=code_block_273)
watch_47 = Watch(valueAtKey_45)
flatten_23 = List.Flatten(list=watch_47)
code_block_274 = CodeBlock { "TargetFuncValuesUnit"; }
valueAtKey_46 = DesignScript.Builtin.Dictionary.ValueAtKey(dictionary=code_block_270, key=code_block_274)
watch_48 = Watch(valueAtKey_46)
flatten_24 = List.Flatten(list=watch_48)
list_create_6 = List.Create(item0=flatten_21, item1=flatten_22, item2=flatten_23, item3=flatten_24)
transpose_5 = List.Transpose(lists=list_create_6)

# group: 패밀리 별 취합 + Export Excel(By OpenpyXl)
# note: Excel Export Button
boolean_3 = BoolSelector(true)
join_5 = List.Join(list0=transpose_3, list1=transpose_4, list2=transpose_5)
watch_49 = Watch()  # unwired: arg0
if_6 = If(test=boolean_3, true=join_5, false=watch_49)
python_script_export_excel_by_2 = Python(IN[0]=if_6)  # "Python Script@Export Excel(By OpenpyXl)"; CPython3; frozen
# ---------- python_script_export_excel_by_2.python (151 lines) ----------
# Load the Python Standard and DesignScript Libraries
import sys
import os
#sys.path.append(r'C:\Users\HEC\AppData\Local\Programs\Python\Python39\Lib\site-packages')
#sys.path.append(r'C:\Users\pjmk0\AppData\Local\Programs\Python\Python39\Lib\site-packages')
sys.path.append(os.getenv('LOCALAPPDATA').replace('\\','\\\\') + r'\Programs\Python\Python39\Lib\site-packages')
import clr
clr.AddReference('ProtoGeometry')
from Autodesk.DesignScript.Geometry import *
from collections import Iterable

def iterable(obj):
    return isinstance(obj, Iterable)


# The inputs to this node will be stored as a list in the IN variables.
dataEnteringNode = IN
ListIn = IN[0]

# Place your code below this line
import datetime
from datetime import date, timedelta
Today = date.today()
import openpyxl
from openpyxl.styles import Border, Side, PatternFill, Font, GradientFill, Alignment, Color, numbers

sample_items = ListIn


def write_to_file(filepath):
    wb = openpyxl.Workbook()
    for sheet in wb.sheetnames:
        wb.remove(wb[sheet])

    thin = Side(border_style="thin", color="000000")
    double = Side(border_style="double", color="000000")

    ws = wb.create_sheet(title='Wall_Calc_instance', index=0)

    ws.merge_cells('A1:L1')
    ws['A1'] = 'HEC Wall Category Calculation Sheet'
    cell = ws['A1']
    cell.font = openpyxl.styles.Font(color='000000', size=20)
    cell.fill = openpyxl.styles.fills.PatternFill(patternType='solid',
                                                  fgColor=openpyxl.styles.colors.Color(rgb='fff3b0'))

    ws['A2'] = 'Item Number'
    ws['A2'].font = openpyxl.styles.Font(b=True, color='000000', size=12)
    #ws['B2'] = 'Member Name'
    #ws['B2'].font = openpyxl.styles.Font(b=True, color='000000', size=12)
    #ws['C2'] = 'Category'
    #ws['C2'].font = openpyxl.styles.Font(b=True, color='000000', size=12)
    ws['B2'] = 'Family Type'
    ws['B2'].font = openpyxl.styles.Font(b=True, color='000000', size=12)
    ws['C2'] = 'WorkMaster Code'
    ws['C2'].font = openpyxl.styles.Font(b=True, color='000000', size=12)
    #ws['F2'] = 'WorkMaster Description'
    #ws['F2'].font = openpyxl.styles.Font(b=True, color='000000', size=12)
    #ws['G2'] = 'Unit'
    #ws['G2'].font = openpyxl.styles.Font(b=True, color='000000', size=12)
    #ws['H2'] = '계수'
    #ws['H2'].font = openpyxl.styles.Font(b=True, color='000000', size=12)
    #ws['I2'] = '계산 참조값'
    #ws['I2'].font = openpyxl.styles.Font(b=True, color='000000', size=12)
    ws['D2'] = 'Quantities'
    ws['D2'].font = openpyxl.styles.Font(b=True, color='000000', size=12)
    ws['E2'] = 'Unit'
    ws['E2'].font = openpyxl.styles.Font(b=True, color='000000', size=12)
    ws['F2'] = 'Unit Price'
    ws['F2'].font = openpyxl.styles.Font(b=True, color='000000', size=12)
    ws['G2'] = 'Total Price'
    ws['G2'].font = openpyxl.styles.Font(b=True, color='000000', size=12)


## 칼럼별 너비 조정 구간
#    for col in range(ws.max_column):
#        ws.column_dimensions[chr(ord('A') + col)].width = 15
    ws.column_dimensions['A'].width = 15
    ws.column_dimensions['B'].width = 45
    ws.column_dimensions['C'].width = 60
    ws.column_dimensions['D'].width = 20
    ws.column_dimensions['E'].width = 20
    ws.column_dimensions['F'].width = 20
    ws.column_dimensions['G'].width = 20
    #ws.column_dimensions['G'].width = 9
    #ws.column_dimensions['H'].width = 9
    #ws.column_dimensions['H'].hidden = True
    #ws.column_dimensions['I'].width = 12
    #ws.column_dimensions['I'].hidden = True
    #ws.column_dimensions['J'].width = 12
    #ws.column_dimensions['K'].width = 12
    #ws.column_dimensions['L'].width = 12

###
    start_row = 3
    for (row, item) in enumerate(sample_items, start_row):
        cell = ws.cell(row=row, column=1, value=row - 2)
        cell.alignment = openpyxl.styles.Alignment(horizontal='center', vertical='center')

#        cell = ws.cell(row=row, column=2, value=item[0])
#        cell.number_format = openpyxl.styles.numbers.FORMAT_DATE_YYYYMMDD2  # 'yyyy-mm-dd'
        ws.cell(row=row, column=2, value=item[0]) ## Family Type 칼럼

        ws.cell(row=row, column=3, value=item[1]) ## WorkMaster Code 칼럼
        
        ws.cell(row=row, column=4, value=item[2]) ## Quantities 칼럼
        
        ws.cell(row=row, column=5, value=item[3]) ## Unit 칼럼
        
        #cell = ws.cell(row=row, column=8, value=item[6]) ## 계수 칼럼
        #cell.number_format = openpyxl.styles.numbers.builtin_format_code(3)  # '#,##0'
        
        #cell = ws.cell(row=row, column=9, value=item[7]) ## 계산 참조값 칼럼
        #cell.number_format = openpyxl.styles.numbers.builtin_format_code(3)  # '#,##0'
        
        #cell = ws.cell(row=row, column=10, value=item[8]) ## Quantities 칼럼
        #cell.number_format = openpyxl.styles.numbers.builtin_format_code(3)  # '#,##0'
        #cell.font = openpyxl.styles.Font(b=True, color='000000', size=11)

        cell = ws.cell(row=row, column=7, value='= D{current_row}*F{current_row}'.format(current_row=cell.row))
        cell.number_format = '#,##0'

#        cell = ws.cell(row=row, column=6, value='= D{current_row} * E{current_row}'.format(current_row=cell.row))
#        cell.number_format = openpyxl.styles.numbers.builtin_format_code(3)

    total_row = ws.max_row + 1
    if total_row > start_row:
        cell1 = ws.cell(row=total_row, column=6, value='Total')
        cell1.font = openpyxl.styles.Font(b=True, color='000000', size=15)
        
        cell2 = ws.cell(row=total_row, column=7, value='= SUM(G{}:G{})'.format(start_row, total_row - 1))
        cell2.number_format = openpyxl.styles.numbers.builtin_format_code(3)
        cell2.border = Border(top=double, left=double, right=double, bottom=double)
        cell2.font = openpyxl.styles.Font(b=True, color='ff03ce', size=15)
    

    wb.save(filepath)
    wb.close()


##if __name__ == '__main__':
#write_to_file('C:\\Users\\pjmk0\\AppData\\Roaming\\test.xlsx')

save_name = "HecStrFDNCalcSheet_" + Today.strftime("%Y-%m-%d")+".xlsx"
path = os.getenv('APPDATA').replace('\\','\\\\')
filePath = path + '\\' + save_name

write_to_file(filePath)

# Assign your output to the OUT variable.
OUT = os.getenv('APPDATA')
# ----------------------------------------
