# Dynamo graph TEST_Str Foundation Calculator_ExcelZoneRevise(0722).dyn (Dynamo 2.10.1.3976)

# group: All Element
categories = Categories("OST_StructuralFoundation")
all_elements_of_category = ElementsOfCategory(Category=categories)

# group: Get Used Family Type of Modeling
code_block = CodeBlock(InputElement=all_elements_of_category) { _InputElement; }
name = Element.Name(element=code_block)
code_block_2 = CodeBlock { "_"; }
split = String.Split(str=name, separator0=code_block_2)
firstItem = List.FirstItem(list=split@L2)
uniqueItems = List.UniqueItems(list=firstItem)
code_block_3 = CodeBlock(UsedFamilyTypeofMode=uniqueItems)
# ---------- code_block_3.designscript (3 lines) ----------
{
"UsedFamilyTypeofModeling": _UsedFamilyTypeofModeling
};
# ----------------------------------------

# group: Excel Import
code_block_4 = CodeBlock(InputDic=code_block_3) { _InputDic; }
code_block_5 = CodeBlock { "UsedFamilyTypeofModeling"; }
valueAtKey = DesignScript.Builtin.Dictionary.ValueAtKey(dictionary=code_block_4, key=code_block_5)
file_path = Filename(".\BIM_물량집계 자동화 산출기준표_rC(20210722).xlsx")
file_from_path = FileObject(path=file_path)
string_from_object = FromObject(object=file_from_path)
code_block_6 = CodeBlock { "Scope_lv2(Str Foundations)"; }
python_script_import_excel_by = Python(IN[0]=string_from_object, IN[1]=code_block_6)  # "Python Script@Import Excel(By OpenpyXl)"; CPython3
# ---------- python_script_import_excel_by.python (50 lines) ----------
# Load the Python Standard and DesignScript Libraries
import sys
import os
#sys.path.append(r'C:\Users\HEC\AppData\Local\Programs\Python\Python39\Lib\site-packages')
#sys.path.append(r'C:\Users\pjmk0\AppData\Local\Programs\Python\Python39\Lib\site-packages')
sys.path.append(os.getenv('LOCALAPPDATA').replace('\\','\\\\') + r'\Programs\Python\Python39\Lib\site-packages')
import clr
clr.AddReference('ProtoGeometry')
from Autodesk.DesignScript.Geometry import *
from collections import Iterable

def iterable(obj):
    return isinstance(obj, Iterable)


# The inputs to this node will be stored as a list in the IN variables.
dataEnteringNode = IN
PathIn = IN[0]
SheetNameIn = IN[1]

# Place your code below this line
import datetime
import openpyxl

path = (PathIn)
#path = (r'C:\Users\pjmk0\Downloads\MK\mQ\BIM_물량집계 자동화 산출기준표_rC(20210607)_mk_de.xlsx')

wb_obj = openpyxl.load_workbook(path, data_only=True)
sheet_obj = wb_obj.get_sheet_by_name(SheetNameIn)

m_row = sheet_obj.max_row
m_col = sheet_obj.max_column

listOut = []



for i in range(1, m_row +1):
    listTemp = []
    for j in range(1, m_col + 1):
        cell_obj = sheet_obj.cell(row=i, column=j)
        listTemp.append(cell_obj.value)
        if len(listTemp) == m_col:
            listOut.append(listTemp)
        


# Assign your output to the OUT variable.
OUT = listOut
#OUT = os.getenv('APPDATA')
# ----------------------------------------
code_block_7 = CodeBlock(UsedFamilyTypeofMode=valueAtKey, ExcelWholeDataSet=python_script_import_excel_by)
# ---------- code_block_7.designscript (4 lines) ----------
{
"UsedFamilyTypeofModeling": _UsedFamilyTypeofModeling,
"ExcelWholeDataSet": _ExcelWholeDataSet
};
# ----------------------------------------

# group: Excel Column Data Set
code_block_8 = CodeBlock(InputDic=code_block_7) { _InputDic; }
code_block_9 = CodeBlock { "ExcelWholeDataSet"; }
valueAtKey_2 = DesignScript.Builtin.Dictionary.ValueAtKey(dictionary=code_block_8, key=code_block_9)
transpose = List.Transpose(lists=valueAtKey_2)
count = List.Count(list=transpose)
code_block_10 = CodeBlock(i=count) { 0..i-1; }
string_from_object_2 = FromObject(object=code_block_10)
byKeysValues = DesignScript.Builtin.Dictionary.ByKeysValues(keys=string_from_object_2, values=transpose)
code_block_11 = CodeBlock { "UsedFamilyTypeofModeling"; }
valueAtKey_3 = DesignScript.Builtin.Dictionary.ValueAtKey(dictionary=code_block_8, key=code_block_11)
code_block_12 = CodeBlock(ExcelWholeDataSet=valueAtKey_2, ExcelColumnDataSet=byKeysValues, UsedFamilyTypeofMode=valueAtKey_3)
# ---------- code_block_12.designscript (5 lines) ----------
{
"ExcelWholeDataSet": _ExcelWholeDataSet,
"ExcelColumnDataSet": _ExcelColumnDataSet,
"UsedFamilyTypeofModeling": _UsedFamilyTypeofModeling
};
# ----------------------------------------

# group: Excel Row Data Set
code_block_13 = CodeBlock(InputDic=code_block_12) { _InputDic; }
code_block_14 = CodeBlock { "ExcelColumnDataSet"; }
valueAtKey_4 = DesignScript.Builtin.Dictionary.ValueAtKey(dictionary=code_block_13, key=code_block_14)
code_block_15 = CodeBlock { "ExcelWholeDataSet"; }
valueAtKey_5 = DesignScript.Builtin.Dictionary.ValueAtKey(dictionary=code_block_13, key=code_block_15)
count_2 = List.Count(list=valueAtKey_5)
code_block_16 = CodeBlock(i=count_2) { 0..i-1; }
string_from_object_3 = FromObject(object=code_block_16)
byKeysValues_2 = DesignScript.Builtin.Dictionary.ByKeysValues(keys=string_from_object_3, values=valueAtKey_5)
code_block_17 = CodeBlock { "UsedFamilyTypeofModeling"; }
valueAtKey_6 = DesignScript.Builtin.Dictionary.ValueAtKey(dictionary=code_block_13, key=code_block_17)
code_block_18 = CodeBlock(ExcelColumnDataSet=valueAtKey_4, ExcelRowDataSet=byKeysValues_2, UsedFamilyTypeofMode=valueAtKey_6)
# ---------- code_block_18.designscript (5 lines) ----------
{
"ExcelColumnDataSet": _ExcelColumnDataSet,
"ExcelRowDataSet": _ExcelRowDataSet,
"UsedFamilyTypeofModeling": _UsedFamilyTypeofModeling
};
# ----------------------------------------

# group: 사용된 패밀리타입이 위치한 Column Index 추출
code_block_19 = CodeBlock(InputDic=code_block_18) { _InputDic; }
code_block_20 = CodeBlock { "ExcelRowDataSet"; }
valueAtKey_7 = DesignScript.Builtin.Dictionary.ValueAtKey(dictionary=code_block_19, key=code_block_20)
code_block_21 = CodeBlock { "ExcelColumnDataSet"; }
valueAtKey_8 = DesignScript.Builtin.Dictionary.ValueAtKey(dictionary=code_block_19, key=code_block_21)
code_block_22 = CodeBlock { 3; }
string_from_object_4 = FromObject(object=code_block_22)
valueAtKey_9 = DesignScript.Builtin.Dictionary.ValueAtKey(dictionary=valueAtKey_7, key=string_from_object_4)
string_from_object_5 = FromObject(object=valueAtKey_9)
code_block_23 = CodeBlock { "UsedFamilyTypeofModeling"; }
valueAtKey_10 = DesignScript.Builtin.Dictionary.ValueAtKey(dictionary=code_block_19, key=code_block_23)
contains = String.Contains(searchFor=valueAtKey_10, lacing=CrossProduct)  # unwired: str
map = List.Map(list=string_from_object_5, function=contains)
anyTrue = List.AnyTrue(list=map@L2)
code_block_24 = CodeBlock { true; }
allIndicesOf = List.AllIndicesOf(list=anyTrue, item=code_block_24)
code_block_25 = CodeBlock(ExcelRowDataSet=valueAtKey_7, ExcelColumnDataSet=valueAtKey_8, ColumnIndexOfUsedFam=allIndicesOf)
# ---------- code_block_25.designscript (5 lines) ----------
{
"ExcelRowDataSet": _ExcelRowDataSet,
"ExcelColumnDataSet": _ExcelColumnDataSet,
"ColumnIndexOfUsedFamilyType": _ColumnIndexOfUsedFamilyType
};
# ----------------------------------------

# group: 사용된 패밀리타입 Column Data 추출
code_block_26 = CodeBlock(InputDic=code_block_25) { _InputDic; }
code_block_27 = CodeBlock { "ExcelRowDataSet"; }
valueAtKey_11 = DesignScript.Builtin.Dictionary.ValueAtKey(dictionary=code_block_26, key=code_block_27)
code_block_28 = CodeBlock { "ExcelColumnDataSet"; }
valueAtKey_12 = DesignScript.Builtin.Dictionary.ValueAtKey(dictionary=code_block_26, key=code_block_28)
code_block_29 = CodeBlock { "ColumnIndexOfUsedFamilyType"; }
valueAtKey_13 = DesignScript.Builtin.Dictionary.ValueAtKey(dictionary=code_block_26, key=code_block_29)
string_from_object_6 = FromObject(object=valueAtKey_13)
valueAtKey_14 = DesignScript.Builtin.Dictionary.ValueAtKey(dictionary=valueAtKey_12, key=string_from_object_6)
code_block_30 = CodeBlock { 4; ""; }
# note: 불필요 정보 처리
replaceItemAtIndex = List.ReplaceItemAtIndex(list=valueAtKey_14@L2, index=code_block_30.out0, item=code_block_30.out1)
code_block_31 = CodeBlock(ExcelRowDataSet=valueAtKey_11, ExcelColumnDataSet=valueAtKey_12, ColumnIndexOfUsedFam=valueAtKey_13, ColumnDataSetOfUsedF=replaceItemAtIndex)
# ---------- code_block_31.designscript (6 lines) ----------
{
"ExcelRowDataSet": _ExcelRowDataSet,
"ExcelColumnDataSet": _ExcelColumnDataSet,
"ColumnIndexOfUsedFamilyType": _ColumnIndexOfUsedFamilyType,
"ColumnDataSetOfUsedFamilyType": _ColumnDataSetOfUsedFamilyType
};
# ----------------------------------------

# group: 사용된 패밀리 타입에서 세부코드가 기입된 Row Index 및 Data Set 추출
code_block_32 = CodeBlock(InputDic=code_block_31) { _InputDic; }
code_block_33 = CodeBlock { "ExcelRowDataSet"; }
valueAtKey_15 = DesignScript.Builtin.Dictionary.ValueAtKey(dictionary=code_block_32, key=code_block_33)
code_block_34 = CodeBlock { "ColumnDataSetOfUsedFamilyType"; }
valueAtKey_16 = DesignScript.Builtin.Dictionary.ValueAtKey(dictionary=code_block_32, key=code_block_34)
string_from_object_7 = FromObject(object=valueAtKey_16)
code_block_35 = CodeBlock { "000"; }
contains_2 = String.Contains(str=string_from_object_7@L2, searchFor=code_block_35, lacing=CrossProduct)
code_block_36 = CodeBlock { true; }
allIndicesOf_2 = List.AllIndicesOf(list=contains_2@L2, item=code_block_36)
string_from_object_8 = FromObject(object=allIndicesOf_2)
valueAtKey_17 = DesignScript.Builtin.Dictionary.ValueAtKey(dictionary=valueAtKey_15, key=string_from_object_8)
code_block_37 = CodeBlock(RowDataSetOfUsedWork=valueAtKey_17, ColumnDataSetOfUsedF=valueAtKey_16, TargetRowIndex=allIndicesOf_2)
# ---------- code_block_37.designscript (5 lines) ----------
{
"RowDataSetOfUsedWorkMaster": _RowDataSetOfUsedWorkMaster,
"ColumnDataSetOfUsedFamilyType": _ColumnDataSetOfUsedFamilyType,
"TargetRowIndex": _TargetRowIndex
};
# ----------------------------------------

code_block_38 = CodeBlock(InputDic=code_block_37) { _InputDic; }
code_block_39 = CodeBlock { "ColumnDataSetOfUsedFamilyType"; }
valueAtKey_18 = DesignScript.Builtin.Dictionary.ValueAtKey(dictionary=code_block_38, key=code_block_39)
code_block_40 = CodeBlock { "TargetRowIndex"; }
valueAtKey_19 = DesignScript.Builtin.Dictionary.ValueAtKey(dictionary=code_block_38, key=code_block_40)
getItemAtIndex = List.GetItemAtIndex(list=valueAtKey_18@@L2, index=valueAtKey_19@L2)
code_block_41 = CodeBlock { "RowDataSetOfUsedWorkMaster"; }
valueAtKey_20 = DesignScript.Builtin.Dictionary.ValueAtKey(dictionary=code_block_38, key=code_block_41)
code_block_42 = CodeBlock { 0; }
getItemAtIndex_2 = List.GetItemAtIndex(list=valueAtKey_20@@L2, index=code_block_42)
code_block_43 = CodeBlock { 1; }
getItemAtIndex_3 = List.GetItemAtIndex(list=valueAtKey_20@@L2, index=code_block_43)
code_block_44 = CodeBlock { 2; }
getItemAtIndex_4 = List.GetItemAtIndex(list=valueAtKey_20@@L2, index=code_block_44)
code_block_45 = CodeBlock { 3; }
getItemAtIndex_5 = List.GetItemAtIndex(list=valueAtKey_20@@L2, index=code_block_45)
code_block_46 = CodeBlock { 4; }
getItemAtIndex_6 = List.GetItemAtIndex(list=valueAtKey_20@@L2, index=code_block_46)
