# Dynamo graph Str Foundation Calculator_DataStructureTest(0718).dyn (Dynamo 2.10.1.3976)

code_block = CodeBlock { 0..100; }
watch = Watch(code_block)
code_block_2 = CodeBlock { 0..100..#11; }
watch_2 = Watch(code_block_2)
byCoordinates = Point.ByCoordinates(x=watch_2, y=watch_2, z=watch_2, lacing=CrossProduct)
code_block_3 = CodeBlock()
# ---------- code_block_3.designscript (5 lines) ----------
[
2000,
2500,
3000
];
# ----------------------------------------
code_block_4 = CodeBlock()  # same code as code_block_3
code_block_5 = CodeBlock()
# ---------- code_block_5.designscript (5 lines) ----------
[
500,
600,
700
];
# ----------------------------------------
code_block_6 = CodeBlock()
# ---------- code_block_6.designscript (5 lines) ----------
[
"AA00232AD-00001",
"AA00232AD-00002",
"AA00232AD-00003"
];
# ----------------------------------------
byLengths = Cuboid.ByLengths(width=code_block_3, length=code_block_4, height=code_block_5)
area = Solid.Area(solid=byLengths)
volume = Solid.Volume(solid=byLengths)
code_block_7 = CodeBlock(width=code_block_3, length=code_block_4, height=code_block_5, material=code_block_6, solid=byLengths, surfaceArea=area, volume=volume)
# ---------- code_block_7.designscript (9 lines) ----------
{
"Width": width,
"Length": length,
"Height": height,
"Material": material,
"Solid": solid,
"SurfaceArea": surfaceArea/1000000,
"Volume": volume/1000000000
};
# ----------------------------------------
watch_3 = Watch(code_block_7)
components = DesignScript.Builtin.Dictionary.Components(dictionary=watch_3)
transpose = List.Transpose(lists=components.values)
code_block_8 = CodeBlock()  # same code as code_block_3
code_block_9 = CodeBlock()  # same code as code_block_3
code_block_10 = CodeBlock()
# ---------- code_block_10.designscript (5 lines) ----------
[
500,
500,
500
];
# ----------------------------------------
code_block_11 = CodeBlock()  # same code as code_block_6
byLengths_2 = Cuboid.ByLengths(width=code_block_8, length=code_block_9, height=code_block_10)
area_2 = Solid.Area(solid=byLengths_2)
volume_2 = Solid.Volume(solid=byLengths_2)
code_block_12 = CodeBlock(width=code_block_8, length=code_block_9, height=code_block_10, material=code_block_11, solid=byLengths_2, surfaceArea=area_2, volume=volume_2)  # same code as code_block_7
list_create = List.Create(item0=code_block_7, item1=code_block_12)
code_block_13 = CodeBlock(i=list_create) { i[0]; }
code_block_14 = CodeBlock { "Height"; }
valueAtKey = DesignScript.Builtin.Dictionary.ValueAtKey(dictionary=watch_3, key=code_block_14)
code_block_15 = CodeBlock(i=valueAtKey) { i==500; }
code_block_16 = CodeBlock()
# ---------- code_block_16.designscript (5 lines) ----------
[
"FT112",
"FT113",
"FT114"
];
# ----------------------------------------
code_block_17 = CodeBlock()  # same code as code_block_3
code_block_18 = CodeBlock()  # same code as code_block_3
code_block_19 = CodeBlock()  # same code as code_block_5
code_block_20 = CodeBlock()
# ---------- code_block_20.designscript (11 lines) ----------
[
["AA00232AD-00001",
"AA00232AD-00002",
"AA00232AD-00003"],
["AA00232AD-00004",
"AA00232AD-00005",
"AA00232AD-00006"],
["AA00232AD-00007",
"AA00232AD-00008",
"AA00232AD-00009"]
];
# ----------------------------------------
code_block_21 = CodeBlock()
# ---------- code_block_21.designscript (5 lines) ----------
[
"F1",
"F2",
"F3"
];
# ----------------------------------------
number_slider = DoubleSlider(6325.6, range=0..10000 step 0.1)
number_slider_2 = DoubleSlider(7844.2, range=0..10000 step 0.1)

# group: 위치입력부
byCoordinates_2 = Point.ByCoordinates(x=number_slider, y=number_slider_2)
code_block_22 = CodeBlock { 0; 6000; }
byCoordinates_3 = Point.ByCoordinates(x=code_block_22.out1)
byCoordinates_4 = Point.ByCoordinates(y=code_block_22.out1)
join = List.Join(list0=byCoordinates_2, list1=byCoordinates_3, list2=byCoordinates_4)

mQ_DataStructureTest1 = Custom[mQ_DataStructureTest1](ElementType=code_block_16, Width=code_block_17, Length=code_block_18, Height=code_block_19, Material=code_block_20, MemberName=code_block_21, Origin=join)  # mQ_DataStructureTest1
code_block_23 = CodeBlock { "Volume"; }
valueAtKey_2 = DesignScript.Builtin.Dictionary.ValueAtKey(dictionary=mQ_DataStructureTest1, key=code_block_23)
components_2 = DesignScript.Builtin.Dictionary.Components(dictionary=mQ_DataStructureTest1)
transpose_2 = List.Transpose(lists=components_2.values)
code_block_24 = CodeBlock { "MemberName"; }
valueAtKey_3 = DesignScript.Builtin.Dictionary.ValueAtKey(dictionary=mQ_DataStructureTest1, key=code_block_24)
code_block_25 = CodeBlock { "F2"; }
allIndicesOf = List.AllIndicesOf(list=valueAtKey_3, item=code_block_25)
firstItem = List.FirstItem(list=allIndicesOf)
getItemAtIndex = List.GetItemAtIndex(list=transpose_2, index=firstItem)
code_block_26 = CodeBlock(i=transpose_2) { i[0]; }
code_block_27 = CodeBlock()
# ---------- code_block_27.designscript (4 lines) ----------
[
"Location",
"Material"
];
# ----------------------------------------
allIndicesOf_2 = List.AllIndicesOf(list=components_2.keys, item=code_block_27)
getItemAtIndex_2 = List.GetItemAtIndex(list=code_block_26, index=allIndicesOf_2)

# group: Data structure_Example
code_block_28 = CodeBlock { _MemberName: var[]..[]; }  # unwired: MemberName
code_block_29 = CodeBlock(MemberName=code_block_28)
# ---------- code_block_29.designscript (12 lines) ----------
_MemberName;
i=[Imperative]
{
	if (_MemberName == null)
	{
		return "none";
	}
	else
	{
		return _MemberName;
	}
};
# ----------------------------------------
code_block_30 = CodeBlock { _ElementType: var[]..[]; }  # unwired: ElementType
code_block_31 = CodeBlock(ElementType=code_block_30)
# ---------- code_block_31.designscript (12 lines) ----------
_ElementType;
i=[Imperative]
{
	if (_ElementType == null)
	{
		return "none";
	}
	else
	{
		return _ElementType;
	}
};
# ----------------------------------------
code_block_32 = CodeBlock { _Width: var[]..[]; }  # unwired: Width
code_block_33 = CodeBlock(Width=code_block_32)
# ---------- code_block_33.designscript (12 lines) ----------
_Width;
i=[Imperative]
{
	if (_Width == null)
	{
		return 1;
	}
	else
	{
		return _Width;
	}
};
# ----------------------------------------
code_block_34 = CodeBlock { _Length: var[]..[]; }  # unwired: Length
code_block_35 = CodeBlock(Length=code_block_34)
# ---------- code_block_35.designscript (12 lines) ----------
_Length;
i=[Imperative]
{
	if (_Length == null)
	{
		return 1;
	}
	else
	{
		return _Length;
	}
};
# ----------------------------------------
code_block_36 = CodeBlock { _Height: var[]..[]; }  # unwired: Height
code_block_37 = CodeBlock(Height=code_block_36)
# ---------- code_block_37.designscript (12 lines) ----------
_Height;
i=[Imperative]
{
	if (_Height == null)
	{
		return 1;
	}
	else
	{
		return _Height;
	}
};
# ----------------------------------------
code_block_38 = CodeBlock { _Material: var[]..[]; }  # unwired: Material
code_block_39 = CodeBlock(Material=code_block_38) { _Material; }
code_block_40 = CodeBlock { _Origin: Autodesk.DesignScript.Geometry.Point[]..[]; }  # unwired: Origin
code_block_41 = CodeBlock(Origin=code_block_40)
# ---------- code_block_41.designscript (12 lines) ----------
_Origin;
i=[Imperative]
{
	if (_Origin == null)
	{
		return Point.Origin();
	}
	else
	{
		return _Origin;
	}
};
# ----------------------------------------
byLengths_3 = Cuboid.ByLengths(origin=code_block_41.out1, width=code_block_33.out1, length=code_block_35.out1, height=code_block_37.out1)
area_3 = Solid.Area(solid=byLengths_3)
volume_3 = Solid.Volume(solid=byLengths_3)
centroid = Solid.Centroid(solid=byLengths_3)
code_block_42 = CodeBlock(memberName=code_block_29.out1, elementType=code_block_31.out1, width=code_block_33.out1, length=code_block_35.out1, height=code_block_37.out1, material=code_block_39, cuboid=byLengths_3, surfaceArea=area_3, volume=volume_3, location=centroid)
# ---------- code_block_42.designscript (12 lines) ----------
{
"MemberName": memberName,
"ElementType": elementType,
"Width": width,
"Length": length,
"Height": height,
"Material": material,
"Cuboid": cuboid,
"SurfaceArea": surfaceArea/1000000,
"Volume": volume/1000000000,
"Location": location
};
# ----------------------------------------
code_block_43 = CodeBlock(DataStructure=code_block_42) { DataStructure; }

categories = Categories("OST_StructuralFoundation")
all_elements_of_category = ElementsOfCategory(Category=categories)
code_block_44 = CodeBlock(Element=all_elements_of_category) { _Element; }
count = List.Count(list=code_block_44)
map = List.Map()  # unwired: list, function
code_block_45 = CodeBlock { "getGeometry()"; }
valueAtKey_4 = DesignScript.Builtin.Dictionary.ValueAtKey(key=code_block_45)  # unwired: dictionary

# group: 이름 중 패밀리 코드 추출
name = Element.Name(element=code_block_44)
code_block_46 = CodeBlock { "_"; }
split = String.Split(str=name, separator0=code_block_46)
firstItem_2 = List.FirstItem(list=split@L2)

getLocation = Element.GetLocation()  # unwired: element
map_2 = List.Map(list=code_block_44, function=getLocation)
getMaterials = Element.GetMaterials()  # unwired: element
map_3 = List.Map(list=code_block_44, function=getMaterials)
name_2 = Element.Name(element=map_3)
code_block_47 = CodeBlock(element=code_block_44, elementType=name, familyCode=firstItem_2, location=map_2, material=map_3, wmCode=name_2)  # unwired: function, functionTargetWM, surfaceArea, volume
# ---------- code_block_47.designscript (12 lines) ----------
{
"Element": element,
"ElementType": elementType,
"FamilyCode": familyCode,
"Location": location,
"Material": material,
"WMCode": wmCode ,
"Function[]": _function,
"FunctionTargetWM": _functionTargetWM,
"SurfaceArea": surfaceArea/1000000,
"Volume": volume/1000000000
};
# ----------------------------------------
watch_4 = Watch(code_block_47)
code_block_48 = CodeBlock { "Element"; }
valueAtKey_5 = DesignScript.Builtin.Dictionary.ValueAtKey(dictionary=watch_4, key=code_block_48)
laceShortest = List.LaceShortest(combineFunction=map, list0=valueAtKey_4, list1=valueAtKey_5)
targetFamily = CodeBlock { "FT112"; }
contains = String.Contains(str=firstItem_2, searchFor=targetFamily)
code_block_49 = CodeBlock { true; }
allIndicesOf_3 = List.AllIndicesOf(list=contains, item=code_block_49)
string_from_array = FromArray(array=allIndicesOf_3)
map_4 = List.Map()  # unwired: list, function
volume_4 = Solid.Volume()  # unwired: solid
element = Watch(code_block_44)
getItemAtIndex_3 = List.GetItemAtIndex(list=element, index=allIndicesOf_3)
join_2 = List.Join(list0=volume_4, list1=getItemAtIndex_3)
firstItem_3 = List.FirstItem(list=join_2)
code_block_50 = CodeBlock { 1; }
dropItems = List.DropItems(list=join_2, amount=code_block_50)
count_2 = List.Count(list=dropItems)
ofRepeatedItem = List.OfRepeatedItem(item=firstItem_3, amount=count_2)
geometry = Element.Geometry(element=dropItems)
laceShortest_2 = List.LaceShortest(combineFunction=map_4, list0=ofRepeatedItem, list1=geometry)
code_block_51 = CodeBlock(targetFamily=targetFamily, targetWM=name_2)
# ---------- code_block_51.designscript (4 lines) ----------
{
"TargetFamily": targetFamily,
"TargetWM": targetWM
};
# ----------------------------------------
mQ_DataStructureTest1_2 = Custom[mQ_DataStructureTest1]()  # unwired: ElementType, Width, Length, Height, Material, MemberName, Origin
code_block_52 = CodeBlock { 2; }
mul = _ * code_block_52  # unwired: x
add = _ + code_block_52  # unwired: x
div = _ / code_block_52  # unwired: x
join_3 = List.Join(list0=mul, list1=add, list2=div)
byKeysValues = DesignScript.Builtin.Dictionary.ByKeysValues(keys=name_2, values=join_3)
code_block_53 = CodeBlock()  # same code as code_block_20
