# Dynamo graph Str Foundation Calculator_DataStructureTest(0722).dyn (Dynamo 2.10.1.3976)

categories = Categories("OST_StructuralFoundation")
all_elements_of_category = ElementsOfCategory(Category=categories)

# group: All Elements of Category
watch_all_elements_of_category = Watch(all_elements_of_category)  # "Watch@All Elements of Category - WALLS"

# group: D. Family Type
watch_all_elements_of_category_2 = Watch(watch_all_elements_of_category)  # "Watch@All Elements of Category - WALLS"
name = Element.Name(element=watch_all_elements_of_category_2)

# group: Excel Import
file_path = Filename(".\BIM_물량집계 자동화 산출기준표_rC(20210722).xlsx")
file_from_path = FileObject(path=file_path)
string_from_object = FromObject(object=file_from_path)
code_block = CodeBlock { "Scope_lv2(Str Foundations)"; }
python_script_import_excel_by = Python(IN[0]=string_from_object, IN[1]=code_block)  # "Python Script@Import Excel(By OpenpyXl)"; CPython3
# ---------- python_script_import_excel_by.python (50 lines) ----------
# Load the Python Standard and DesignScript Libraries
import sys
import os
#sys.path.append(r'C:\Users\HEC\AppData\Local\Programs\Python\Python39\Lib\site-packages')
#sys.path.append(r'C:\Users\pjmk0\AppData\Local\Programs\Python\Python39\Lib\site-packages')
sys.path.append(os.getenv('LOCALAPPDATA').replace('\\','\\\\') + r'\Programs\Python\Python39\Lib\site-packages')
import clr
clr.AddReference('ProtoGeometry')
from Autodesk.DesignScript.Geometry import *
from collections import Iterable

def iterable(obj):
    return isinstance(obj, Iterable)


# The inputs to this node will be stored as a list in the IN variables.
dataEnteringNode = IN
PathIn = IN[0]
SheetNameIn = IN[1]

# Place your code below this line
import datetime
import openpyxl

path = (PathIn)
#path = (r'C:\Users\pjmk0\Downloads\MK\mQ\BIM_물량집계 자동화 산출기준표_rC(20210607)_mk_de.xlsx')

wb_obj = openpyxl.load_workbook(path, data_only=True)
sheet_obj = wb_obj.get_sheet_by_name(SheetNameIn)

m_row = sheet_obj.max_row
m_col = sheet_obj.max_column

listOut = []



for i in range(1, m_row +1):
    listTemp = []
    for j in range(1, m_col + 1):
        cell_obj = sheet_obj.cell(row=i, column=j)
        listTemp.append(cell_obj.value)
        if len(listTemp) == m_col:
            listOut.append(listTemp)
        


# Assign your output to the OUT variable.
OUT = listOut
#OUT = os.getenv('APPDATA')
# ----------------------------------------
code_block_2 = CodeBlock { false; }
importExcel = Data.ImportExcel(file=file_from_path, sheetName=code_block, showExcel=code_block_2)  # frozen

# group: Null값 처리
code_block_3 = CodeBlock { " "; }
isNull = Object.IsNull()  # unwired: object
replaceByCondition = Replace(item=python_script_import_excel_by, replaceWith=code_block_3, condition=isNull)

# group: Whole Data(Column direction)
transpose = List.Transpose(lists=replaceByCondition)
watch = Watch(transpose)

# group: Whole Data(row direction)
watch_2 = Watch(replaceByCondition)

# group: Column Index Guide
code_block_4 = CodeBlock(i=watch_2) { i[3]; }
watch_3 = Watch(code_block_4)

# group: 모델링에 사용된 모든 패밀리타입 코드 추출
name_2 = Element.Name(element=watch_all_elements_of_category)
uniqueItems = List.UniqueItems(list=name_2@L2)
flatten = List.Flatten(list=uniqueItems)
watch_4 = Watch(flatten)
code_block_5 = CodeBlock { "_"; }
split = String.Split(str=watch_4, separator0=code_block_5)
firstItem = List.FirstItem(list=split@L2)

uniqueItems_2 = List.UniqueItems(list=firstItem)

# group: 사용된 패밀리타입이 위치한 Column Index 추출
string_from_object_2 = FromObject(object=watch_3)
contains = String.Contains(searchFor=uniqueItems_2, lacing=CrossProduct)  # unwired: str
map = List.Map(list=string_from_object_2, function=contains)
code_block_6 = CodeBlock { true; }

anyTrue = List.AnyTrue(list=map@L2)

# group (continued): 사용된 패밀리타입이 위치한 Column Index 추출
allIndicesOf = List.AllIndicesOf(list=anyTrue, item=code_block_6)

# group: 사용된 패밀리타입 Column Data 추출
watch_5 = Watch(allIndicesOf)
getItemAtIndex = List.GetItemAtIndex(list=watch, index=watch_5)
code_block_7 = CodeBlock { 4; ""; }
# note: 불필요 정보 처리
replaceItemAtIndex = List.ReplaceItemAtIndex(list=getItemAtIndex@L2, index=code_block_7.out0, item=code_block_7.out1)
watch_6 = Watch(getItemAtIndex)

whole_data_row_direction = Object.Identity(object=watch_2)

# group: 사용된 패밀리 타입에서 세부코드가 기입된 Row 열 번호 추출
string_from_object_3 = FromObject(object=replaceItemAtIndex)
code_block_8 = CodeBlock { "000"; }
contains_2 = String.Contains(str=string_from_object_3@L2, searchFor=code_block_8, lacing=CrossProduct)
code_block_9 = CodeBlock { true; }
allIndicesOf_2 = List.AllIndicesOf(list=contains_2@L2, item=code_block_9)
watch_7 = Watch(allIndicesOf_2)

# group: WM code 추출
watch_8 = Watch(replaceItemAtIndex)
whole_data_row_direction_2 = Object.Identity(object=whole_data_row_direction)
getItemAtIndex_2 = List.GetItemAtIndex(list=whole_data_row_direction_2, index=watch_7@L2)
watch_9 = Watch(getItemAtIndex_2)
code_block_10 = CodeBlock { 0; }
getItemAtIndex_3 = List.GetItemAtIndex(list=watch_9@@L2, index=code_block_10)
watch_10 = Watch(getItemAtIndex_3)
getItemAtIndex_4 = List.GetItemAtIndex(list=watch_8@@L2, index=watch_7@L2)
watch_11 = Watch(getItemAtIndex_4)
code_block_11 = CodeBlock { 2; }
getItemAtIndex_5 = List.GetItemAtIndex(list=watch_9@@L2, index=code_block_11)
watch_12 = Watch(getItemAtIndex_5)
code_block_12 = CodeBlock { 3; }
getItemAtIndex_6 = List.GetItemAtIndex(list=watch_9@@L2, index=code_block_12)
watch_13 = Watch(getItemAtIndex_6)
code_block_13 = CodeBlock { 4; }
getItemAtIndex_7 = List.GetItemAtIndex(list=watch_9@@L2, index=code_block_13)
watch_14 = Watch(getItemAtIndex_7)
code_block_14 = CodeBlock(i=whole_data_row_direction_2) { i[3]; }
watch_15 = Watch(code_block_14)

code_block_15 = CodeBlock { 1; }
getItemAtIndex_8 = List.GetItemAtIndex(list=watch_9@@L2, index=code_block_15)
watch_16 = Watch(getItemAtIndex_8)

# group (continued): WM code 추출
code_block_16 = CodeBlock(i=watch_10, j=watch_11, k=watch_16, l=watch_12, m=watch_13, n=watch_14) { i +"-"+ j; "("+ k + " " + l + " " + m + " " + n +")"; }

# group: Family Type: WM Code 딕셔너리 생성(모델링에 포함 되지 않은 WM code 까지 포함되어야함)
code_block_17 = CodeBlock { 3; }
getItemAtIndex_9 = List.GetItemAtIndex(list=watch_8@L2, index=code_block_17)
code_block_18 = CodeBlock { "_"; "-"; }
split_2 = String.Split(str=getItemAtIndex_9, separator0=code_block_18.out0, separator1=code_block_18.out1)
firstItem_2 = List.FirstItem(list=split_2@L2)
byKeysValues = DesignScript.Builtin.Dictionary.ByKeysValues(keys=firstItem_2, values=code_block_16.out0)
watch_17 = Watch(byKeysValues)
byKeysValues_2 = DesignScript.Builtin.Dictionary.ByKeysValues(keys=firstItem_2)  # unwired: values

# group: material inform from excel sheet <per family type>
watch_18 = Watch(watch_17)

# group: material inform from excel sheet <per element>
name_3 = Element.Name(element=watch_all_elements_of_category_2)
keys = DesignScript.Builtin.Dictionary.Keys(dictionary=watch_18)
contains_3 = String.Contains(str=name_3, searchFor=keys, lacing=CrossProduct)
code_block_19 = CodeBlock { true; }
allIndicesOf_3 = List.AllIndicesOf(list=contains_3@L2, item=code_block_19)
flatten_2 = List.Flatten(list=allIndicesOf_3)
getItemAtIndex_10 = List.GetItemAtIndex(list=keys, index=flatten_2)
valueAtKey = DesignScript.Builtin.Dictionary.ValueAtKey(dictionary=watch_18, key=getItemAtIndex_10)

# group: WorkMaster 미포함 객체 제외(임시)
anyTrue_2 = List.AnyTrue(list=contains_3@L2)
filterByBoolMask = List.FilterByBoolMask(list=watch_all_elements_of_category_2, mask=anyTrue_2)

# group: material inform from modeling <per element>
getMaterials = Element.GetMaterials(element=filterByBoolMask.in)
name_4 = Element.Name(element=getMaterials)
code_block_20 = CodeBlock { "_"; }
split_3 = String.Split(str=name_4, separator0=code_block_20)
firstItem_3 = List.FirstItem(list=split_3@L2)
count = List.Count(list=getMaterials@L2)
chop = List.Chop(list=firstItem_3, lengths=count)

# group: 합집합
list_create = List.Create(item0=chop, item1=valueAtKey)
transpose_2 = List.Transpose(lists=list_create)
watch_19 = Watch(transpose_2)
code_block_21 = CodeBlock { 1; }
flatten_3 = List.Flatten(list=watch_19@L3, amt=code_block_21)

# group: WM 중복제거
uniqueItems_3 = List.UniqueItems(list=flatten_3@L2)

watch_wm_합집합_중복제거 = Watch(uniqueItems_3)

# group: Set Up Dictionary <all Element Inform>
# note: Input Node
code_block_22 = CodeBlock(Element=all_elements_of_category) { _Element; }
name_5 = Element.Name(element=code_block_22)
code_block_23 = CodeBlock { "_"; }
split_4 = String.Split(str=name_5, separator0=code_block_23)
firstItem_4 = List.FirstItem(list=split_4@L2)
getLocation = Element.GetLocation()  # unwired: element
map_2 = List.Map(list=code_block_22, function=getLocation)
# note: Excel Import
code_block_24 = CodeBlock(WMtotal=watch_wm_합집합_중복제거) { _WMtotal; }
code_block_25 = CodeBlock(element=code_block_22, elementType=name_5, familyCode=firstItem_4, location=map_2, wmCode=code_block_24)
# ---------- code_block_25.designscript (10 lines) ----------
{
"Element": element,
"ElementType": elementType,
"FamilyCode": familyCode,
"Location": location,
//"Material": material,
"WMCode": wmCode
//"SurfaceArea": surfaceArea/1000000,
//"Volume": volume/1000000000
};
# ----------------------------------------

# group: Select Target Family
code_block_26 = CodeBlock(DicIn=code_block_25) { _DicIn; }
code_block_27 = CodeBlock { "FamilyCode"; }
valueAtKey_2 = DesignScript.Builtin.Dictionary.ValueAtKey(dictionary=code_block_26, key=code_block_27)
targetFamily = CodeBlock()
# ---------- targetFamily.designscript (5 lines) ----------
[
"FT21",
"FT11",
"FT12"
];
# ----------------------------------------
contains_4 = String.Contains(str=valueAtKey_2, searchFor=targetFamily@L1)
code_block_28 = CodeBlock { true; }
allIndicesOf_4 = List.AllIndicesOf(list=contains_4@L2, item=code_block_28)
code_block_29 = CodeBlock { "Element"; }
valueAtKey_3 = DesignScript.Builtin.Dictionary.ValueAtKey(dictionary=code_block_26, key=code_block_29)
getItemAtIndex_11 = List.GetItemAtIndex(list=valueAtKey_3, index=allIndicesOf_4)
name_6 = Element.Name(element=getItemAtIndex_11)
code_block_30 = CodeBlock { "WMCode"; }
valueAtKey_4 = DesignScript.Builtin.Dictionary.ValueAtKey(dictionary=code_block_26, key=code_block_30)
getItemAtIndex_12 = List.GetItemAtIndex(list=valueAtKey_4, index=allIndicesOf_4)
code_block_31 = CodeBlock(targetFamilyIndex=allIndicesOf_4, targetFamilyCode=name_6, targetElements=getItemAtIndex_11, WMforTargetElements=getItemAtIndex_12)
# ---------- code_block_31.designscript (7 lines) ----------
{
//"TargetFamily[]": targetFamily,
"TargetFamilyIndex": targetFamilyIndex,
"TargetFamilyCode": targetFamilyCode,
"TargetElements": targetElements,
"WMforTargetElements": WMforTargetElements
};
# ----------------------------------------

components = DesignScript.Builtin.Dictionary.Components(dictionary=code_block_31)
transpose_3 = List.Transpose(lists=components.values)
watch_20 = Watch(transpose_3)

# group: Row Index Guide
code_block_32 = CodeBlock(i=watch) { i[3]; }
watch_21 = Watch(code_block_32)

# group: C. Category
code_block_33 = CodeBlock { "Category"; }
getParameterValueByName = Element.GetParameterValueByName(element=watch_all_elements_of_category, parameterName=code_block_33)

code_block_34 = CodeBlock {  }
code_block_35 = CodeBlock {  }

# group: func0
code_block_36 = CodeBlock { "Volume"; }
getParameterValueByName_2 = Element.GetParameterValueByName(parameterName=code_block_36)  # unwired: element

# group: func1
createExcavationSolid = Custom[CreateExcavationSolid]()  # CreateExcavationSolidForISOFDN; unwired: Element
volume = Solid.Volume()  # unwired: solid
sum = Math.Sum()  # unwired: values
code_block_37 = CodeBlock { 1000000000; }
div = _ / code_block_37  # unwired: x
function_compose = ComposeFunctions(function0=createExcavationSolid.Solid, function1=volume, function2=sum, function3=div)

# group: func2
createBaseCourseSurfaces = Custom[CreateBaseCourseSurfaces]()  # CreateBaseCourseSurfaces; unwired: Element
area = Surface.Area()  # unwired: surface
sum_2 = Math.Sum()  # unwired: values
code_block_38 = CodeBlock { 1000000; }
div_2 = _ / code_block_38  # unwired: x
function_compose_2 = ComposeFunctions(function0=createBaseCourseSurfaces.Surface, function1=area, function2=sum_2, function3=div_2)

# group: func3
createLeanConcrete = Custom[CreateLeanConcrete]()  # CreateLeanConcreteForISOFDN; unwired: Element
volume_2 = Solid.Volume()  # unwired: solid
sum_3 = Math.Sum()  # unwired: values
code_block_39 = CodeBlock { 1000000000; }
div_3 = _ / code_block_39  # unwired: x
function_compose_3 = ComposeFunctions(function0=createLeanConcrete.Solid, function1=volume_2, function2=sum_3, function3=div_3)

# group: func4
extractSideFacesOfElement = Custom[ExtractSideFacesOfElement]()  # ExtractSideFacesOfElement; unwired: Element
area_2 = Surface.Area()  # unwired: surface
sum_4 = Math.Sum()  # unwired: values
code_block_40 = CodeBlock { 1000000; }
div_4 = _ / code_block_40  # unwired: x
function_compose_4 = ComposeFunctions(function0=extractSideFacesOfElement.Surface, function1=area_2, function2=sum_4, function3=div_4)

# group: func5
code_block_41 = CodeBlock { "Volume"; }
getParameterValueByName_3 = Element.GetParameterValueByName(parameterName=code_block_41)  # unwired: element
code_block_42 = CodeBlock { 0.1; }
mul = _ * code_block_42  # unwired: x
function_compose_5 = ComposeFunctions(function0=getParameterValueByName_3, function1=mul)

# group: func6
createConcreteProtectCoatingSurfaceForFD = Custom[CreateConcreteProtectCoatingSurfaceForFDN]()  # CreateConcreteProtectCoatingSurface; unwired: Element
area_3 = Surface.Area()  # unwired: surface
sum_5 = Math.Sum()  # unwired: values
code_block_43 = CodeBlock { 1000000; }
div_5 = _ / code_block_43  # unwired: x
function_compose_6 = ComposeFunctions(function0=createConcreteProtectCoatingSurfaceForFD.Surface, function1=area_3, function2=sum_5, function3=div_5)

extractUpperFacesOfElement = Custom[ExtractUpperFacesOfElement]()  # ExtractUpperFacesOfElement; unwired: Element

# group: func7
area_4 = Surface.Area()  # unwired: surface
sum_6 = Math.Sum()  # unwired: values
code_block_44 = CodeBlock { 1000000; }
div_6 = _ / code_block_44  # unwired: x
function_compose_7 = ComposeFunctions(function0=extractUpperFacesOfElement.Surface, function1=area_4, function2=sum_6, function3=div_6)

join = List.Join(list0=getParameterValueByName_2, list1=function_compose, list2=function_compose_2, list3=function_compose_3, list4=function_compose_4, list5=function_compose_5, list6=function_compose_6, list7=function_compose_7)

# group: Select Target WorkMasterCode and Function => Connect Target WorkMaster and it's quantities
code_block_45 = CodeBlock(DicIn=code_block_31) { _DicIn; }
components_2 = DesignScript.Builtin.Dictionary.Components(dictionary=code_block_45)
# note: 패밀리 선택
code_block_46 = CodeBlock { 0; }
getItemAtIndex_13 = List.GetItemAtIndex(list=components_2.values@L4, index=code_block_46)
byKeysValues_3 = DesignScript.Builtin.Dictionary.ByKeysValues(keys=components_2.keys, values=getItemAtIndex_13)
code_block_47 = CodeBlock { "WMforTargetElements"; }
valueAtKey_5 = DesignScript.Builtin.Dictionary.ValueAtKey(dictionary=byKeysValues_3, key=code_block_47)
flatten_4 = List.Flatten(list=valueAtKey_5)
uniqueItems_4 = List.UniqueItems(list=flatten_4)
code_block_48 = CodeBlock { "TargetElements"; }
valueAtKey_6 = DesignScript.Builtin.Dictionary.ValueAtKey(dictionary=byKeysValues_3, key=code_block_48)
code_block_49 = CodeBlock { "TargetFamilyCode"; }
valueAtKey_7 = DesignScript.Builtin.Dictionary.ValueAtKey(dictionary=byKeysValues_3, key=code_block_49)
code_block_50 = CodeBlock(targetElements=valueAtKey_6, targetFamilyCode=valueAtKey_7, WMforTargetElements=valueAtKey_5, targetWMunique=uniqueItems_4, targetFunctions=join)
# ---------- code_block_50.designscript (7 lines) ----------
{
"TargetElements": targetElements,
"TargetFamilyCode": targetFamilyCode,
"WMforTargetElements": _WMforTargetElements,
"TargetWMunique": targetWMunique,
"TargetFunctions": targetFunctions
};
# ----------------------------------------

watch_22 = Watch(uniqueItems_4)

# group: Calculate Function with Elements
map_3 = List.Map()  # unwired: list, function
code_block_51 = CodeBlock(DicIn=code_block_50) { _DicIn; }
code_block_52 = CodeBlock { "TargetFunctions"; }
valueAtKey_8 = DesignScript.Builtin.Dictionary.ValueAtKey(dictionary=code_block_51, key=code_block_52)
code_block_53 = CodeBlock { "WMforTargetElements"; }
valueAtKey_9 = DesignScript.Builtin.Dictionary.ValueAtKey(dictionary=code_block_51, key=code_block_53)
code_block_54 = CodeBlock { "TargetWMunique"; }
valueAtKey_10 = DesignScript.Builtin.Dictionary.ValueAtKey(dictionary=code_block_51, key=code_block_54)
allIndicesOf_5 = List.AllIndicesOf(list=valueAtKey_9@L2, item=valueAtKey_10)
clean = List.Clean(list=allIndicesOf_5@L1)
count_2 = List.Count(list=valueAtKey_9@L2)
chop_2 = List.Chop(list=clean, lengths=count_2)
getItemAtIndex_14 = List.GetItemAtIndex(list=valueAtKey_8, index=chop_2)
code_block_55 = CodeBlock { 1; }
# note: Function Duplicate
flatten_5 = List.Flatten(list=getItemAtIndex_14@L3, amt=code_block_55)
flatten_6 = List.Flatten(list=flatten_5)
ofRepeatedItem = List.OfRepeatedItem()  # unwired: item, amount
code_block_56 = CodeBlock { "TargetElements"; }
valueAtKey_11 = DesignScript.Builtin.Dictionary.ValueAtKey(dictionary=code_block_51, key=code_block_56)
flatten_7 = List.Flatten(list=valueAtKey_11)
code_block_57 = CodeBlock { "WMforTargetElements"; }
valueAtKey_12 = DesignScript.Builtin.Dictionary.ValueAtKey(dictionary=code_block_51, key=code_block_57)
count_3 = List.Count(list=valueAtKey_12@L2)
# note: Element Duplicate
laceShortest = List.LaceShortest(combineFunction=ofRepeatedItem, list0=flatten_7, list1=count_3)
flatten_8 = List.Flatten(list=laceShortest)
laceShortest_2 = List.LaceShortest(combineFunction=map_3, list0=flatten_6, list1=flatten_8)

watch_23 = Watch(laceShortest_2)
code_block_58 = CodeBlock { 2; }
round = Math.Round(number=watch_23, digits=code_block_58)

# group: TargetElementsForFunctionTest
watch_24 = Watch(valueAtKey_6)  # "Watch@TargetElementsForFunctionTest"

code_block_59 = CodeBlock(Element=watch_24) { _Element: var[]..[]; }
code_block_60 = CodeBlock(Element=code_block_59) { _Element; }
extractUpperFacesOfElement_2 = Custom[ExtractUpperFacesOfElement](Element=code_block_60)
flatten_9 = List.Flatten(list=extractUpperFacesOfElement_2.Surface)
getJoinedElements = Element.GetJoinedElements(element=code_block_60)
flatten_10 = List.Flatten(list=getJoinedElements)
extractBelowFacesOfElement = Custom[ExtractBelowFacesOfElement](Element=flatten_10)  # ExtractBelowFacesOfElement
flatten_11 = List.Flatten(list=extractBelowFacesOfElement.Surface)
doesIntersect = Geometry.DoesIntersect(geometry=flatten_11, other=flatten_9, lacing=CrossProduct)
code_block_61 = CodeBlock { true; }
allIndicesOf_6 = List.AllIndicesOf(list=doesIntersect@L2, item=code_block_61)
flatten_12 = List.Flatten(list=allIndicesOf_6)
groupByKey = List.GroupByKey(list=flatten_11, keys=flatten_12)
difference = Surface.Difference(surface=flatten_9, others=groupByKey.groups)
extractSideFacesOfElement_2 = Custom[ExtractSideFacesOfElement](Element=code_block_60)
addItemToFront = List.AddItemToFront(item=difference@L1, list=extractSideFacesOfElement_2.Surface@L2)
color_palette = ColorPalette({R: 30, G: 144, B: 255, A: 129})
byGeometryColor = Modifiers.GeometryColor.ByGeometryColor(geometry=addItemToFront, color=color_palette)
code_block_62 = CodeBlock { [1,2,3]; ["a","b","c"]; }
byKeysValues_4 = DesignScript.Builtin.Dictionary.ByKeysValues(keys=code_block_62.out1, values=code_block_62.out0)
code_block_63 = CodeBlock { [4,5,6]; ["d","e","f"]; }
byKeysValues_5 = DesignScript.Builtin.Dictionary.ByKeysValues(keys=code_block_63.out1, values=code_block_63.out0)
code_block_64 = CodeBlock(a1=byKeysValues_4, b1=byKeysValues_5)
# ---------- code_block_64.designscript (4 lines) ----------
{
"a1": a1
,"b1": b1
};
# ----------------------------------------
code_block_65 = CodeBlock { "a1"; }
valueAtKey_13 = DesignScript.Builtin.Dictionary.ValueAtKey(dictionary=code_block_64, key=code_block_65)
code_block_66 = CodeBlock { "a"; }
valueAtKey_14 = DesignScript.Builtin.Dictionary.ValueAtKey(dictionary=valueAtKey_13, key=code_block_66)
flatten_13 = List.Flatten(list=code_block_16.out0)
flatten_14 = List.Flatten(list=code_block_16.out1)
byKeysValues_6 = DesignScript.Builtin.Dictionary.ByKeysValues(keys=flatten_13, values=flatten_14)
count_4 = DesignScript.Builtin.Dictionary.Count(dictionary=byKeysValues_6)
