# Dynamo graph TEST_ExcelToCsv(0722).dyn (Dynamo 2.10.1.3976)

file_path = Filename(".\mqCSV.csv")

# group: Excel Import
file_path_2 = Filename(".\BIM_물량집계 자동화 산출기준표_rC(20210722).xlsx")
file_from_path = FileObject(path=file_path_2)
string_from_object = FromObject(object=file_from_path)
code_block = CodeBlock { "Scope_lv2(Str Foundations)"; }
python_script_import_excel_by = Python(IN[0]=string_from_object, IN[1]=code_block)  # "Python Script@Import Excel(By OpenpyXl)"; CPython3
# ---------- python_script_import_excel_by.python (50 lines) ----------
# Load the Python Standard and DesignScript Libraries
import sys
import os
#sys.path.append(r'C:\Users\HEC\AppData\Local\Programs\Python\Python39\Lib\site-packages')
#sys.path.append(r'C:\Users\pjmk0\AppData\Local\Programs\Python\Python39\Lib\site-packages')
sys.path.append(os.getenv('LOCALAPPDATA').replace('\\','\\\\') + r'\Programs\Python\Python39\Lib\site-packages')
import clr
clr.AddReference('ProtoGeometry')
from Autodesk.DesignScript.Geometry import *
from collections import Iterable

def iterable(obj):
    return isinstance(obj, Iterable)


# The inputs to this node will be stored as a list in the IN variables.
dataEnteringNode = IN
PathIn = IN[0]
SheetNameIn = IN[1]

# Place your code below this line
import datetime
import openpyxl

path = (PathIn)
#path = (r'C:\Users\pjmk0\Downloads\MK\mQ\BIM_물량집계 자동화 산출기준표_rC(20210607)_mk_de.xlsx')

wb_obj = openpyxl.load_workbook(path, data_only=True)
sheet_obj = wb_obj.get_sheet_by_name(SheetNameIn)

m_row = sheet_obj.max_row
m_col = sheet_obj.max_column

listOut = []



for i in range(1, m_row +1):
    listTemp = []
    for j in range(1, m_col + 1):
        cell_obj = sheet_obj.cell(row=i, column=j)
        listTemp.append(cell_obj.value)
        if len(listTemp) == m_col:
            listOut.append(listTemp)
        


# Assign your output to the OUT variable.
OUT = listOut
#OUT = os.getenv('APPDATA')
# ----------------------------------------

# group: Null값 처리
code_block_2 = CodeBlock { " "; }
isNull = Object.IsNull()  # unwired: object
replaceByCondition = Replace(item=python_script_import_excel_by, replaceWith=code_block_2, condition=isNull)

exportCSV = Data.ExportCSV(filePath=file_path, data=replaceByCondition)
