# Dynamo graph TEST_Str Foundation Calculator_ExcelZoneRevise(0722).dyn (Dynamo 2.10.1.3976)

# note: GetWorkMasterCodePerElement

# group: All Element
categories = Categories("OST_StructuralFoundation")
all_elements_of_category = ElementsOfCategory(Category=categories)

# group: GetUsedFamilyTypeOfModeling
code_block = CodeBlock(InputElement=all_elements_of_category) { _InputElement; }
name = Element.Name(element=code_block)
code_block_2 = CodeBlock { "_"; }
split = String.Split(str=name, separator0=code_block_2)
firstItem = List.FirstItem(list=split@L2)
uniqueItems = List.UniqueItems(list=firstItem)
code_block_3 = CodeBlock(AllElement=code_block, UsedFamilyTypeOfMode=uniqueItems)
# ---------- code_block_3.designscript (4 lines) ----------
{
"AllElement": _AllElement,
"UsedFamilyTypeOfModeling": _UsedFamilyTypeOfModeling
};
# ----------------------------------------

# group: Select Excel and Sheet
file_path = Filename(".\BIM_물량집계 자동화 산출기준표_rC(20210722).xlsx")
file_from_path = FileObject(path=file_path)
code_block_4 = CodeBlock { "Scope_lv2(Str Foundations)"; }

# group: ImportExcel
code_block_5 = CodeBlock(InputDic=code_block_3) { _InputDic; }
code_block_6 = CodeBlock { "AllElement"; }
valueAtKey = DesignScript.Builtin.Dictionary.ValueAtKey(dictionary=code_block_5, key=code_block_6)
code_block_7 = CodeBlock { "UsedFamilyTypeOfModeling"; }
valueAtKey_2 = DesignScript.Builtin.Dictionary.ValueAtKey(dictionary=code_block_5, key=code_block_7)
code_block_8 = CodeBlock(InputFilePath=file_from_path) { _InputFilePath; }
string_from_object = FromObject(object=code_block_8)
code_block_9 = CodeBlock(InputSheetName=code_block_4) { _InputSheetName; }
string_from_object_2 = FromObject(object=code_block_9)
python_script_import_excel_by = Python(IN[0]=string_from_object, IN[1]=string_from_object_2)  # "Python Script@Import Excel(By OpenpyXl)"; CPython3
# ---------- python_script_import_excel_by.python (50 lines) ----------
# Load the Python Standard and DesignScript Libraries
import sys
import os
#sys.path.append(r'C:\Users\HEC\AppData\Local\Programs\Python\Python39\Lib\site-packages')
#sys.path.append(r'C:\Users\pjmk0\AppData\Local\Programs\Python\Python39\Lib\site-packages')
sys.path.append(os.getenv('LOCALAPPDATA').replace('\\','\\\\') + r'\Programs\Python\Python39\Lib\site-packages')
import clr
clr.AddReference('ProtoGeometry')
from Autodesk.DesignScript.Geometry import *
from collections import Iterable

def iterable(obj):
    return isinstance(obj, Iterable)


# The inputs to this node will be stored as a list in the IN variables.
dataEnteringNode = IN
PathIn = IN[0]
SheetNameIn = IN[1]

# Place your code below this line
import datetime
import openpyxl

path = (PathIn)
#path = (r'C:\Users\pjmk0\Downloads\MK\mQ\BIM_물량집계 자동화 산출기준표_rC(20210607)_mk_de.xlsx')

wb_obj = openpyxl.load_workbook(path, data_only=True)
sheet_obj = wb_obj.get_sheet_by_name(SheetNameIn)

m_row = sheet_obj.max_row
m_col = sheet_obj.max_column

listOut = []



for i in range(1, m_row +1):
    listTemp = []
    for j in range(1, m_col + 1):
        cell_obj = sheet_obj.cell(row=i, column=j)
        listTemp.append(cell_obj.value)
        if len(listTemp) == m_col:
            listOut.append(listTemp)
        


# Assign your output to the OUT variable.
OUT = listOut
#OUT = os.getenv('APPDATA')
# ----------------------------------------
code_block_10 = CodeBlock(AllElement=valueAtKey, UsedFamilyTypeOfMode=valueAtKey_2, ExcelWholeDataSet=python_script_import_excel_by)
# ---------- code_block_10.designscript (5 lines) ----------
{
"AllElement": _AllElement,
"UsedFamilyTypeOfModeling": _UsedFamilyTypeOfModeling,
"ExcelWholeDataSet": _ExcelWholeDataSet
};
# ----------------------------------------

# group: GetExcelColumnDataSet
code_block_11 = CodeBlock(InputDic=code_block_10) { _InputDic; }
code_block_12 = CodeBlock { "AllElement"; }
valueAtKey_3 = DesignScript.Builtin.Dictionary.ValueAtKey(dictionary=code_block_11, key=code_block_12)
code_block_13 = CodeBlock { "ExcelWholeDataSet"; }
valueAtKey_4 = DesignScript.Builtin.Dictionary.ValueAtKey(dictionary=code_block_11, key=code_block_13)
transpose = List.Transpose(lists=valueAtKey_4)
count = List.Count(list=transpose)
code_block_14 = CodeBlock(i=count) { 0..i-1; }
string_from_object_3 = FromObject(object=code_block_14)
byKeysValues = DesignScript.Builtin.Dictionary.ByKeysValues(keys=string_from_object_3, values=transpose)
code_block_15 = CodeBlock { "UsedFamilyTypeOfModeling"; }
valueAtKey_5 = DesignScript.Builtin.Dictionary.ValueAtKey(dictionary=code_block_11, key=code_block_15)
code_block_16 = CodeBlock(AllElement=valueAtKey_3, ExcelWholeDataSet=valueAtKey_4, ExcelColumnDataSet=byKeysValues, UsedFamilyTypeOfMode=valueAtKey_5)
# ---------- code_block_16.designscript (6 lines) ----------
{
"AllElement": _AllElement,
"ExcelWholeDataSet": _ExcelWholeDataSet,
"ExcelColumnDataSet": _ExcelColumnDataSet,
"UsedFamilyTypeOfModeling": _UsedFamilyTypeOfModeling
};
# ----------------------------------------

# group: GetExcelRowDataSet
code_block_17 = CodeBlock(InputDic=code_block_16) { _InputDic; }
code_block_18 = CodeBlock { "AllElement"; }
valueAtKey_6 = DesignScript.Builtin.Dictionary.ValueAtKey(dictionary=code_block_17, key=code_block_18)
code_block_19 = CodeBlock { "ExcelColumnDataSet"; }
valueAtKey_7 = DesignScript.Builtin.Dictionary.ValueAtKey(dictionary=code_block_17, key=code_block_19)
code_block_20 = CodeBlock { "ExcelWholeDataSet"; }
valueAtKey_8 = DesignScript.Builtin.Dictionary.ValueAtKey(dictionary=code_block_17, key=code_block_20)
count_2 = List.Count(list=valueAtKey_8)
code_block_21 = CodeBlock(i=count_2) { 0..i-1; }
string_from_object_4 = FromObject(object=code_block_21)
byKeysValues_2 = DesignScript.Builtin.Dictionary.ByKeysValues(keys=string_from_object_4, values=valueAtKey_8)
code_block_22 = CodeBlock { "UsedFamilyTypeOfModeling"; }
valueAtKey_9 = DesignScript.Builtin.Dictionary.ValueAtKey(dictionary=code_block_17, key=code_block_22)
code_block_23 = CodeBlock(AllElement=valueAtKey_6, ExcelColumnDataSet=valueAtKey_7, ExcelRowDataSet=byKeysValues_2, UsedFamilyTypeOfMode=valueAtKey_9)
# ---------- code_block_23.designscript (6 lines) ----------
{
"AllElement": _AllElement,
"ExcelColumnDataSet": _ExcelColumnDataSet,
"ExcelRowDataSet": _ExcelRowDataSet,
"UsedFamilyTypeOfModeling": _UsedFamilyTypeOfModeling
};
# ----------------------------------------

# group: GetColumnIndexOfUsedFamilyType
code_block_24 = CodeBlock(InputDic=code_block_23) { _InputDic; }
code_block_25 = CodeBlock { "AllElement"; }
valueAtKey_10 = DesignScript.Builtin.Dictionary.ValueAtKey(dictionary=code_block_24, key=code_block_25)
code_block_26 = CodeBlock { "ExcelRowDataSet"; }
valueAtKey_11 = DesignScript.Builtin.Dictionary.ValueAtKey(dictionary=code_block_24, key=code_block_26)
code_block_27 = CodeBlock { "ExcelColumnDataSet"; }
valueAtKey_12 = DesignScript.Builtin.Dictionary.ValueAtKey(dictionary=code_block_24, key=code_block_27)
code_block_28 = CodeBlock { 3; }
string_from_object_5 = FromObject(object=code_block_28)
valueAtKey_13 = DesignScript.Builtin.Dictionary.ValueAtKey(dictionary=valueAtKey_11, key=string_from_object_5)
string_from_object_6 = FromObject(object=valueAtKey_13)
code_block_29 = CodeBlock { "UsedFamilyTypeOfModeling"; }
valueAtKey_14 = DesignScript.Builtin.Dictionary.ValueAtKey(dictionary=code_block_24, key=code_block_29)
contains = String.Contains(searchFor=valueAtKey_14, lacing=CrossProduct)  # unwired: str
map = List.Map(list=string_from_object_6, function=contains)
anyTrue = List.AnyTrue(list=map@L2)
code_block_30 = CodeBlock { true; }
allIndicesOf = List.AllIndicesOf(list=anyTrue, item=code_block_30)
code_block_31 = CodeBlock(AllElement=valueAtKey_10, ExcelRowDataSet=valueAtKey_11, ExcelColumnDataSet=valueAtKey_12, ColumnIndexOfUsedFam=allIndicesOf, UsedFamilyTypeOfMode=valueAtKey_14)
# ---------- code_block_31.designscript (7 lines) ----------
{
"AllElement": _AllElement,
"ExcelRowDataSet": _ExcelRowDataSet,
"ExcelColumnDataSet": _ExcelColumnDataSet,
"ColumnIndexOfUsedFamilyType": _ColumnIndexOfUsedFamilyType,
"UsedFamilyTypeOfModeling": _UsedFamilyTypeOfModeling
};
# ----------------------------------------

# group: GetColumnDataSetOfUsedFamilyType
code_block_32 = CodeBlock(InputDic=code_block_31) { _InputDic; }
code_block_33 = CodeBlock { "AllElement"; }
valueAtKey_15 = DesignScript.Builtin.Dictionary.ValueAtKey(dictionary=code_block_32, key=code_block_33)
code_block_34 = CodeBlock { "ExcelRowDataSet"; }
valueAtKey_16 = DesignScript.Builtin.Dictionary.ValueAtKey(dictionary=code_block_32, key=code_block_34)
code_block_35 = CodeBlock { "ExcelColumnDataSet"; }
valueAtKey_17 = DesignScript.Builtin.Dictionary.ValueAtKey(dictionary=code_block_32, key=code_block_35)
code_block_36 = CodeBlock { "ColumnIndexOfUsedFamilyType"; }
valueAtKey_18 = DesignScript.Builtin.Dictionary.ValueAtKey(dictionary=code_block_32, key=code_block_36)
string_from_object_7 = FromObject(object=valueAtKey_18)
valueAtKey_19 = DesignScript.Builtin.Dictionary.ValueAtKey(dictionary=valueAtKey_17, key=string_from_object_7)
code_block_37 = CodeBlock { 4; ""; }
# note: 불필요 정보 처리
replaceItemAtIndex = List.ReplaceItemAtIndex(list=valueAtKey_19@L2, index=code_block_37.out0, item=code_block_37.out1)
code_block_38 = CodeBlock { "UsedFamilyTypeOfModeling"; }
valueAtKey_20 = DesignScript.Builtin.Dictionary.ValueAtKey(dictionary=code_block_32, key=code_block_38)
code_block_39 = CodeBlock(AllElement=valueAtKey_15, ExcelRowDataSet=valueAtKey_16, ExcelColumnDataSet=valueAtKey_17, ColumnIndexOfUsedFam=valueAtKey_18, ColumnDataSetOfUsedF=replaceItemAtIndex, UsedFamilyTypeOfMode=valueAtKey_20)
# ---------- code_block_39.designscript (8 lines) ----------
{
"AllElement": _AllElement,
"ExcelRowDataSet": _ExcelRowDataSet,
"ExcelColumnDataSet": _ExcelColumnDataSet,
"ColumnIndexOfUsedFamilyType": _ColumnIndexOfUsedFamilyType,
"ColumnDataSetOfUsedFamilyType": _ColumnDataSetOfUsedFamilyType,
"UsedFamilyTypeOfModeling": _UsedFamilyTypeOfModeling
};
# ----------------------------------------

# group: GetRowDataSetOfUsedWorkMaster
code_block_40 = CodeBlock(InputDic=code_block_39) { _InputDic; }
code_block_41 = CodeBlock { "AllElement"; }
valueAtKey_21 = DesignScript.Builtin.Dictionary.ValueAtKey(dictionary=code_block_40, key=code_block_41)
code_block_42 = CodeBlock { "ExcelRowDataSet"; }
valueAtKey_22 = DesignScript.Builtin.Dictionary.ValueAtKey(dictionary=code_block_40, key=code_block_42)
code_block_43 = CodeBlock { "ColumnDataSetOfUsedFamilyType"; }
valueAtKey_23 = DesignScript.Builtin.Dictionary.ValueAtKey(dictionary=code_block_40, key=code_block_43)
string_from_object_8 = FromObject(object=valueAtKey_23)
code_block_44 = CodeBlock { "000"; }
contains_2 = String.Contains(str=string_from_object_8@L2, searchFor=code_block_44, lacing=CrossProduct)
code_block_45 = CodeBlock { true; }
allIndicesOf_2 = List.AllIndicesOf(list=contains_2@L2, item=code_block_45)
string_from_object_9 = FromObject(object=allIndicesOf_2)
valueAtKey_24 = DesignScript.Builtin.Dictionary.ValueAtKey(dictionary=valueAtKey_22, key=string_from_object_9)
code_block_46 = CodeBlock { "UsedFamilyTypeOfModeling"; }
valueAtKey_25 = DesignScript.Builtin.Dictionary.ValueAtKey(dictionary=code_block_40, key=code_block_46)
code_block_47 = CodeBlock(AllElement=valueAtKey_21, RowDataSetOfUsedWork=valueAtKey_24, ColumnDataSetOfUsedF=valueAtKey_23, TargetWMRowIndex=allIndicesOf_2, UsedFamilyTypeOfMode=valueAtKey_25)
# ---------- code_block_47.designscript (7 lines) ----------
{
"AllElement": _AllElement,
"RowDataSetOfUsedWorkMaster": _RowDataSetOfUsedWorkMaster,
"ColumnDataSetOfUsedFamilyType": _ColumnDataSetOfUsedFamilyType,
"TargetWMRowIndex": _TargetWMRowIndex,
"UsedFamilyTypeOfModeling": _UsedFamilyTypeOfModeling
};
# ----------------------------------------

# group: GetMatchedWorkMasterAndDescription
code_block_48 = CodeBlock(InputDic=code_block_47) { _InputDic; }
code_block_49 = CodeBlock { "AllElement"; }
valueAtKey_26 = DesignScript.Builtin.Dictionary.ValueAtKey(dictionary=code_block_48, key=code_block_49)
code_block_50 = CodeBlock { "RowDataSetOfUsedWorkMaster"; }
valueAtKey_27 = DesignScript.Builtin.Dictionary.ValueAtKey(dictionary=code_block_48, key=code_block_50)
code_block_51 = CodeBlock { "ColumnDataSetOfUsedFamilyType"; }
valueAtKey_28 = DesignScript.Builtin.Dictionary.ValueAtKey(dictionary=code_block_48, key=code_block_51)
code_block_52 = CodeBlock { "TargetWMRowIndex"; }
valueAtKey_29 = DesignScript.Builtin.Dictionary.ValueAtKey(dictionary=code_block_48, key=code_block_52)
code_block_53 = CodeBlock { "UsedFamilyTypeOfModeling"; }
valueAtKey_30 = DesignScript.Builtin.Dictionary.ValueAtKey(dictionary=code_block_48, key=code_block_53)
code_block_54 = CodeBlock { 0; }
getItemAtIndex = List.GetItemAtIndex(list=valueAtKey_27@@L2, index=code_block_54)
getItemAtIndex_2 = List.GetItemAtIndex(list=valueAtKey_28@@L2, index=valueAtKey_29@L2)
code_block_55 = CodeBlock(i=getItemAtIndex, j=getItemAtIndex_2) { i +"-"+ j; }
code_block_56 = CodeBlock { 1; }
getItemAtIndex_3 = List.GetItemAtIndex(list=valueAtKey_27@@L2, index=code_block_56)
code_block_57 = CodeBlock { 2; }
getItemAtIndex_4 = List.GetItemAtIndex(list=valueAtKey_27@@L2, index=code_block_57)
code_block_58 = CodeBlock { 3; }
getItemAtIndex_5 = List.GetItemAtIndex(list=valueAtKey_27@@L2, index=code_block_58)
code_block_59 = CodeBlock { 4; }
getItemAtIndex_6 = List.GetItemAtIndex(list=valueAtKey_27@@L2, index=code_block_59)
code_block_60 = CodeBlock(a=getItemAtIndex_3, b=getItemAtIndex_4, c=getItemAtIndex_5, d=getItemAtIndex_6) { a +" "+ b +" "+ c +" "+"("+ d +")"; }
code_block_61 = CodeBlock(AllElement=valueAtKey_26, RowDataSetOfUsedWork=valueAtKey_27, ColumnDataSetOfUsedF=valueAtKey_28, TargetWMRowIndex=valueAtKey_29, UsedFamilyTypeOfMode=valueAtKey_30, MatchedWorkGruopAndM=code_block_55, MatchedWMDescription=code_block_60)
# ---------- code_block_61.designscript (9 lines) ----------
{
"AllElement": _AllElement,
"RowDataSetOfUsedWorkMaster": _RowDataSetOfUsedWorkMaster,
"ColumnDataSetOfUsedFamilyType": _ColumnDataSetOfUsedFamilyType,
"TargetWMRowIndex": _TargetWMRowIndex,
"UsedFamilyTypeOfModeling": _UsedFamilyTypeOfModeling,
"MatchedWorkGruopAndMasterCode": _MatchedWorkGruopAndMasterCode,
"MatchedWMDescription": _MatchedWMDescription
};
# ----------------------------------------

# group: GetWorkMasterCodePerFamilyTypeAndWMDescriptionDictionary
code_block_62 = CodeBlock(InputDic=code_block_61) { _InputDic; }
code_block_63 = CodeBlock { "AllElement"; }
valueAtKey_31 = DesignScript.Builtin.Dictionary.ValueAtKey(dictionary=code_block_62, key=code_block_63)
code_block_64 = CodeBlock { "ColumnDataSetOfUsedFamilyType"; }
valueAtKey_32 = DesignScript.Builtin.Dictionary.ValueAtKey(dictionary=code_block_62, key=code_block_64)
code_block_65 = CodeBlock { 3; }
# note: UsedFamilyTypeInExcelOrder
getItemAtIndex_7 = List.GetItemAtIndex(list=valueAtKey_32@L2, index=code_block_65)
code_block_66 = CodeBlock { "_"; }
split_2 = String.Split(str=getItemAtIndex_7, separator0=code_block_66)
firstItem_2 = List.FirstItem(list=split_2@L2)
code_block_67 = CodeBlock(InputDic=code_block_62) { _InputDic; }
code_block_68 = CodeBlock { "MatchedWorkGruopAndMasterCode"; }
valueAtKey_33 = DesignScript.Builtin.Dictionary.ValueAtKey(dictionary=code_block_67, key=code_block_68)
byKeysValues_3 = DesignScript.Builtin.Dictionary.ByKeysValues(keys=firstItem_2, values=valueAtKey_33)
flatten = List.Flatten(list=valueAtKey_33)
code_block_69 = CodeBlock { "MatchedWMDescription"; }
valueAtKey_34 = DesignScript.Builtin.Dictionary.ValueAtKey(dictionary=code_block_62, key=code_block_69)
flatten_2 = List.Flatten(list=valueAtKey_34)
# note: WM - description dictionary
byKeysValues_4 = DesignScript.Builtin.Dictionary.ByKeysValues(keys=flatten, values=flatten_2)
code_block_70 = CodeBlock(AllElement=valueAtKey_31, WorkMasterCodePerFam=byKeysValues_3, WMAndDescriptionDict=byKeysValues_4)
# ---------- code_block_70.designscript (9 lines) ----------
{
"AllElement": _AllElement,
//"RowDataSetOfUsedWorkMaster": _RowDataSetOfUsedWorkMaster,
//"ColumnDataSetOfUsedFamilyType": _ColumnDataSetOfUsedFamilyType,
//"TargetWMRowIndex": _TargetWMRowIndex,
//"UsedFamilyTypeOfModeling": _UsedFamilyTypeOfModeling,
"WorkMasterCodePerFamilyType": _WorkMasterCodePerFamilyType,
"WMAndDescriptionDictionary": _WMAndDescriptionDictionary
};
# ----------------------------------------

# group: GetWorkMasterCodePerElement
code_block_71 = CodeBlock(InputDic=code_block_70) { _InputDic; }
code_block_72 = CodeBlock { "AllElement"; }
valueAtKey_35 = DesignScript.Builtin.Dictionary.ValueAtKey(dictionary=code_block_71, key=code_block_72)
code_block_73 = CodeBlock { "WorkMasterCodePerFamilyType"; }
valueAtKey_36 = DesignScript.Builtin.Dictionary.ValueAtKey(dictionary=code_block_71, key=code_block_73)
keys = DesignScript.Builtin.Dictionary.Keys(dictionary=valueAtKey_36)
name_2 = Element.Name(element=valueAtKey_35)
contains_3 = String.Contains(str=name_2@L1, searchFor=keys)
code_block_74 = CodeBlock { true; }
allIndicesOf_3 = List.AllIndicesOf(list=contains_3@L2, item=code_block_74)
flatten_3 = List.Flatten(list=allIndicesOf_3)
getItemAtIndex_8 = List.GetItemAtIndex(list=keys, index=flatten_3)
valueAtKey_37 = DesignScript.Builtin.Dictionary.ValueAtKey(dictionary=valueAtKey_36, key=getItemAtIndex_8)
getMaterials = Element.GetMaterials(element=valueAtKey_35)
code_block_75 = CodeBlock { "WMAndDescriptionDictionary"; }
valueAtKey_38 = DesignScript.Builtin.Dictionary.ValueAtKey(dictionary=code_block_71, key=code_block_75)
code_block_76 = CodeBlock(AllElement=valueAtKey_35, WorkMasterCodePerFam=valueAtKey_36, WorkMasterCodePerEle=valueAtKey_37, MaterialPerElementFr=getMaterials, WMAndDescriptionDict=valueAtKey_38)
# ---------- code_block_76.designscript (11 lines) ----------
{
"AllElement": _AllElement,
//"RowDataSetOfUsedWorkMaster": _RowDataSetOfUsedWorkMaster,
//"ColumnDataSetOfUsedFamilyType": _ColumnDataSetOfUsedFamilyType,
//"TargetWMRowIndex": _TargetWMRowIndex,
//"UsedFamilyTypeOfModeling": _UsedFamilyTypeOfModeling,
"WorkMasterCodePerFamilyType": _WorkMasterCodePerFamilyType,
"WorkMasterCodePerElement": _WorkMasterCodePerElement,
"MaterialPerElementFromModeling": _MaterialPerElementFromModeling,
"WMAndDescriptionDictionary": _WMAndDescriptionDictionary
};
# ----------------------------------------

# group: GetWorkMasterCodePerElementAndWMDictionaryFromModeling
code_block_77 = CodeBlock(InputDic=code_block_76) { _InputDic; }
code_block_78 = CodeBlock { "AllElement"; }
valueAtKey_39 = DesignScript.Builtin.Dictionary.ValueAtKey(dictionary=code_block_77, key=code_block_78)
code_block_79 = CodeBlock { "WorkMasterCodePerFamilyType"; }
valueAtKey_40 = DesignScript.Builtin.Dictionary.ValueAtKey(dictionary=code_block_77, key=code_block_79)
code_block_80 = CodeBlock { "WorkMasterCodePerElement"; }
valueAtKey_41 = DesignScript.Builtin.Dictionary.ValueAtKey(dictionary=code_block_77, key=code_block_80)
code_block_81 = CodeBlock { "MaterialPerElementFromModeling"; }
valueAtKey_42 = DesignScript.Builtin.Dictionary.ValueAtKey(dictionary=code_block_77, key=code_block_81)
name_3 = Element.Name(element=valueAtKey_42)
code_block_82 = CodeBlock { "_"; }
split_3 = String.Split(str=name_3, separator0=code_block_82)
firstItem_3 = List.FirstItem(list=split_3@@L2)
code_block_83 = CodeBlock { "WMAndDescriptionDictionary"; }
valueAtKey_43 = DesignScript.Builtin.Dictionary.ValueAtKey(dictionary=code_block_77, key=code_block_83)
flatten_4 = List.Flatten(list=firstItem_3)
code_block_84 = CodeBlock { " "; }
restOfItems = List.RestOfItems(list=split_3@@L2)
join = String.Join(separator=code_block_84, string0=restOfItems@@L2)
flatten_5 = List.Flatten(list=join)
byKeysValues_5 = DesignScript.Builtin.Dictionary.ByKeysValues(keys=flatten_4, values=flatten_5)
code_block_85 = CodeBlock(AllElement=valueAtKey_39, WorkMasterCodePerFam=valueAtKey_40, WorkMasterCodePerEle=valueAtKey_41, MaterialPerElementFr=firstItem_3, WMAndDescriptionDict=valueAtKey_43, MaterialsDescription=byKeysValues_5)
# ---------- code_block_85.designscript (8 lines) ----------
{
"AllElement": _AllElement,
"WorkMasterCodePerFamilyType": _WorkMasterCodePerFamilyType,
"WorkMasterCodePerElement": _WorkMasterCodePerElement,
"MaterialPerElementFromModeling": _MaterialPerElementFromModeling,
"WMAndDescriptionDictionary": _WMAndDescriptionDictionary,
"MaterialsDescriptionDictionary": _MaterialsDescriptionDictionary
};
# ----------------------------------------

# group: GetWorkMasterCodePerElementFromBoth(Excel&Modeling)
code_block_86 = CodeBlock(InputDic=code_block_85) { _InputDic; }
code_block_87 = CodeBlock { "AllElement"; }
valueAtKey_44 = DesignScript.Builtin.Dictionary.ValueAtKey(dictionary=code_block_86, key=code_block_87)
code_block_88 = CodeBlock { "WorkMasterCodePerFamilyType"; }
valueAtKey_45 = DesignScript.Builtin.Dictionary.ValueAtKey(dictionary=code_block_86, key=code_block_88)
code_block_89 = CodeBlock { "MaterialPerElementFromModeling"; }
valueAtKey_46 = DesignScript.Builtin.Dictionary.ValueAtKey(dictionary=code_block_86, key=code_block_89)
code_block_90 = CodeBlock { "WorkMasterCodePerElement"; }
valueAtKey_47 = DesignScript.Builtin.Dictionary.ValueAtKey(dictionary=code_block_86, key=code_block_90)
addItemToFront = List.AddItemToFront(item=valueAtKey_46@L1, list=valueAtKey_47@@L2)
uniqueItems_2 = List.UniqueItems(list=addItemToFront@L2)
code_block_91 = CodeBlock(AllElement=valueAtKey_44, WorkMasterCodePerFam=valueAtKey_45, WorkMasterCodePerEle=uniqueItems_2)
# ---------- code_block_91.designscript (6 lines) ----------
{
"AllElement": _AllElement,
"WorkMasterCodePerFamilyType": _WorkMasterCodePerFamilyType,
"WorkMasterCodePerElementBoth": _WorkMasterCodePerElementBoth
//"WMAndDescriptionDictionaryBoth": _WMAndDescriptionDictionaryBoth
};
# ----------------------------------------

# group: GetWMAndDescriptionDictionaryFromBoth(Excel&Modeling)
code_block_92 = CodeBlock(InputDic=code_block_85) { _InputDic; }
code_block_93 = CodeBlock { "AllElement"; }
valueAtKey_48 = DesignScript.Builtin.Dictionary.ValueAtKey(dictionary=code_block_92, key=code_block_93)
code_block_94 = CodeBlock { "WorkMasterCodePerFamilyType"; }
valueAtKey_49 = DesignScript.Builtin.Dictionary.ValueAtKey(dictionary=code_block_92, key=code_block_94)
code_block_95 = CodeBlock { "MaterialsDescriptionDictionary"; }
valueAtKey_50 = DesignScript.Builtin.Dictionary.ValueAtKey(dictionary=code_block_92, key=code_block_95)
components = DesignScript.Builtin.Dictionary.Components(dictionary=valueAtKey_50)
code_block_96 = CodeBlock { "WMAndDescriptionDictionary"; }
valueAtKey_51 = DesignScript.Builtin.Dictionary.ValueAtKey(dictionary=code_block_92, key=code_block_96)
components_2 = DesignScript.Builtin.Dictionary.Components(dictionary=valueAtKey_51)
contains_4 = String.Contains(str=components_2.keys@@L1, searchFor=components.keys)
anyTrue_2 = List.AnyTrue(list=contains_4@L2)
code_block_97 = CodeBlock { true; }
allIndicesOf_4 = List.AllIndicesOf(list=anyTrue_2, item=code_block_97)
removeItemAtIndex = List.RemoveItemAtIndex(list=components_2.keys, indices=allIndicesOf_4)
addItemToEnd = List.AddItemToEnd(item=components.keys, list=removeItemAtIndex)
flatten_6 = List.Flatten(list=addItemToEnd)
removeItemAtIndex_2 = List.RemoveItemAtIndex(list=components_2.values, indices=allIndicesOf_4)
addItemToEnd_2 = List.AddItemToEnd(item=components.values, list=removeItemAtIndex_2)
flatten_7 = List.Flatten(list=addItemToEnd_2)
byKeysValues_6 = DesignScript.Builtin.Dictionary.ByKeysValues(keys=flatten_6, values=flatten_7)
code_block_98 = CodeBlock(AllElement=valueAtKey_48, WorkMasterCodePerFam=valueAtKey_49, WMAndDescriptionDict=byKeysValues_6)
# ---------- code_block_98.designscript (5 lines) ----------
{
"AllElement": _AllElement,
"WorkMasterCodePerFamilyType": _WorkMasterCodePerFamilyType,
"WMAndDescriptionDictionaryBoth": _WMAndDescriptionDictionaryBoth
};
# ----------------------------------------

# group: GetFullWMCodeDescriptionPerElement
code_block_99 = CodeBlock(InputDic1=code_block_91) { _InputDic1; }
code_block_100 = CodeBlock { "AllElement"; }
valueAtKey_52 = DesignScript.Builtin.Dictionary.ValueAtKey(dictionary=code_block_99, key=code_block_100)
code_block_101 = CodeBlock { "WorkMasterCodePerFamilyType"; }
valueAtKey_53 = DesignScript.Builtin.Dictionary.ValueAtKey(dictionary=code_block_99, key=code_block_101)
code_block_102 = CodeBlock { "WorkMasterCodePerElementBoth"; }
valueAtKey_54 = DesignScript.Builtin.Dictionary.ValueAtKey(dictionary=code_block_99, key=code_block_102)
code_block_103 = CodeBlock(InputDic2=code_block_98) { _InputDic2; }
code_block_104 = CodeBlock { "WMAndDescriptionDictionaryBoth"; }
valueAtKey_55 = DesignScript.Builtin.Dictionary.ValueAtKey(dictionary=code_block_103, key=code_block_104)
valueAtKey_56 = DesignScript.Builtin.Dictionary.ValueAtKey(dictionary=valueAtKey_55, key=valueAtKey_54)
code_block_105 = CodeBlock(a=valueAtKey_54, b=valueAtKey_56) { a +": "+ b; }
code_block_106 = CodeBlock(AllElement=valueAtKey_52, WorkMasterCodePerFam=valueAtKey_53, WorkMasterCodePerEle=valueAtKey_54, FullWMCodeDescriptio=code_block_105)
# ---------- code_block_106.designscript (6 lines) ----------
{
"AllElement": _AllElement,
"WorkMasterCodePerFamilyType": _WorkMasterCodePerFamilyType,
"WorkMasterCodePerElementBoth": _WorkMasterCodePerElementBoth,
"FullWMCodeDescriptionPerElement": _FullWMCodeDescriptionPerElement
};
# ----------------------------------------
