# Dynamo custom node CreateBaseCourseSurfaces.dyf (Dynamo 2.10.1.3976)
# category: mQTest
# CreateBaseCourseSurfaces

Element = Input(_Element: var[]..[])
code_block = CodeBlock(Element=Element) { _Element; }
faces = Element.Faces(element=code_block)
faces_2 = Element.Faces()  # unwired: element
code_block_2 = CodeBlock { 0.5; }
normalAtParameter = Surface.NormalAtParameter(u=code_block_2, v=code_block_2)  # unwired: surface
function_compose = ComposeFunctions(function0=faces_2, function1=normalAtParameter)
function_apply = ApplyFunction(function=function_compose, argument0=code_block)
Z = Vector.Z(vector=function_apply)
code_block_3 = CodeBlock { 0; }
round = Math.Round(number=Z, digits=code_block_3)
code_block_4 = CodeBlock(i=round) { i==-1; }
filterByBoolMask = List.FilterByBoolMask(list=faces, mask=code_block_4)
perimeterCurves = Surface.PerimeterCurves(surface=filterByBoolMask.in)
byJoinedCurves = PolyCurve.ByJoinedCurves(curves=perimeterCurves)
code_block_5 = CodeBlock { _BaseCourseOffsetBottom: var[]..[] = 300; }
offset = Curve.Offset(curve=byJoinedCurves, distance=code_block_5)
code_block_6 = CodeBlock { _leanThick: var[]..[] = 100; }
code_block_7 = CodeBlock(i=code_block_6) { -i; }
# note: GL 까지 translate
translate = Geometry.Translate(geometry=offset, zTranslation=code_block_7)
byPatch = Surface.ByPatch(closedCurve=translate)
Surface = Output(byPatch)
color_palette = ColorPalette({R: 255, G: 0, B: 255, A: 150})
byGeometryColor = Modifiers.GeometryColor.ByGeometryColor(geometry=byPatch, color=color_palette)
GeometryColor = Output(byGeometryColor)
