# Dynamo custom node CreateExcavationSolid.dyf (Dynamo 2.10.1.3976)
# category: mQTest
# CreateExcavationSolidForISOFDN

Element = Input(_Element: var[]..[])
code_block = CodeBlock(Element=Element) { _Element; }
faces = Element.Faces(element=code_block)
faces_2 = Element.Faces()  # unwired: element
code_block_2 = CodeBlock { 0.5; }
normalAtParameter = Surface.NormalAtParameter(u=code_block_2, v=code_block_2)  # unwired: surface
function_compose = ComposeFunctions(function0=faces_2, function1=normalAtParameter)
function_apply = ApplyFunction(function=function_compose, argument0=code_block)
Z = Vector.Z(vector=function_apply)
code_block_3 = CodeBlock { 0; }
round = Math.Round(number=Z, digits=code_block_3)
code_block_4 = CodeBlock(i=round) { i==-1; }
filterByBoolMask = List.FilterByBoolMask(list=faces, mask=code_block_4)
perimeterCurves = Surface.PerimeterCurves(surface=filterByBoolMask.in)
byJoinedCurves = PolyCurve.ByJoinedCurves(curves=perimeterCurves)
ExcavOffsetBottom = Input(_ExcavOffsetBottom: var[]..[] = 300)
offset = Curve.Offset(curve=byJoinedCurves, distance=ExcavOffsetBottom)
flatten = List.Flatten(list=offset)
levels = Levels("G.L")  # graph input
elevation = Level.Elevation(level=levels)
code_block_5 = CodeBlock { "Elevation at Bottom"; }
getParameterValueByName = Element.GetParameterValueByName(element=code_block, parameterName=code_block_5)
sub = elevation - getParameterValueByName
code_block_6 = CodeBlock { 0; }
isNull = Object.IsNull()  # unwired: object
replaceByCondition = Replace(item=sub, replaceWith=code_block_6, condition=isNull)
translate = Geometry.Translate(geometry=offset, zTranslation=replaceByCondition)
ExcavOffsetTop = Input(_ExcavOffsetTop: var[]..[] = 700)
offset_2 = Curve.Offset(curve=translate, distance=ExcavOffsetTop)
flatten_2 = List.Flatten(list=offset_2)
list_create = List.Create(item0=flatten, item1=flatten_2)
transpose = List.Transpose(lists=list_create)
byLoft = Solid.ByLoft(crossSections=transpose)
color_palette = ColorPalette({R: 210, G: 105, B: 30, A: 135})
byGeometryColor = Modifiers.GeometryColor.ByGeometryColor(geometry=byLoft, color=color_palette)
GeometryColor = Output(byGeometryColor)
Solid = Output(byLoft)
ExcavOffsetBottom_2 = Output(ExcavOffsetBottom)  # "_ExcavOffsetBottom"
