# Dynamo custom node CreateProtectionBoardSurfacesForFDN.dyf (Dynamo 2.10.1.3976)
# category: mQTest
# CreateProtectionBoardSurfacesForFDN

Element = Input(_Element: var[]..[])
code_block = CodeBlock(Element=Element) { _Element; }
extractUpperFacesOfElement = Custom[ExtractUpperFacesOfElement](Element=code_block)  # ExtractUpperFacesOfElement
flatten = List.Flatten(list=extractUpperFacesOfElement.Surface)
Surface = Output(flatten)
color_palette = ColorPalette({R: 30, G: 144, B: 255, A: 129})
byGeometryColor = Modifiers.GeometryColor.ByGeometryColor(geometry=flatten, color=color_palette)
GeometryColor = Output(byGeometryColor)
