# Dynamo custom node OrganizeAllElementInformAsDictionary.dyf (Dynamo 2.10.1.3976)
# category: mQTest
# OrganizeAllElementInformAsDictionary

InputDic = Input(_InputDic: var[]..[])

# group: Set Up All Element Inform as Dictionary
# note: Input Node
code_block = CodeBlock(InputDic=InputDic) { _InputDic; }
code_block_2 = CodeBlock { "AllElement"; }
valueAtKey = DesignScript.Builtin.Dictionary.ValueAtKey(dictionary=code_block, key=code_block_2)
name = Element.Name(element=valueAtKey)
code_block_3 = CodeBlock { "_"; }
split = String.Split(str=name, separator0=code_block_3)
firstItem = List.FirstItem(list=split@L2)
code_block_4 = CodeBlock { "FullWMCodeDescriptionPerElement"; }
valueAtKey_2 = DesignScript.Builtin.Dictionary.ValueAtKey(dictionary=code_block, key=code_block_4)
code_block_5 = CodeBlock(Element=valueAtKey, ElementType=name, FamilyCode=firstItem, FullWMCodeDescriptio=valueAtKey_2)
# ---------- code_block_5.designscript (6 lines) ----------
{
"Element": _Element,
"ElementType": _ElementType,
"FamilyCode": _FamilyCode,
"FullWMCodeDescriptionPerElement": _FullWMCodeDescriptionPerElement
};
# ----------------------------------------

Dictionary = Output(code_block_5)
