# Dynamo custom node SelectTargetFamilyInformAsDictionary.dyf (Dynamo 2.10.1.3976)
# category: mQTest
# Select Target Family Element And Connected WorkMasters

InputDic = Input(_InputDic: var[]..[])
InputIndex = Input(_InputIndex: var[]..[])

# group: Select Target Family Element And Connected WorkMasters
code_block = CodeBlock(InputDic=InputDic) { _InputDic; }
code_block_2 = CodeBlock { "Element"; }
valueAtKey = DesignScript.Builtin.Dictionary.ValueAtKey(dictionary=code_block, key=code_block_2)
code_block_3 = CodeBlock { "FamilyCode"; }
valueAtKey_2 = DesignScript.Builtin.Dictionary.ValueAtKey(dictionary=code_block, key=code_block_3)
uniqueItems = List.UniqueItems(list=valueAtKey_2)
watch = Watch(uniqueItems)
code_block_4 = CodeBlock(InputIndex=InputIndex) { _InputIndex; }
targetFamily = CodeBlock(i=watch, j=code_block_4) { i[j]; }
contains = String.Contains(str=valueAtKey_2, searchFor=targetFamily@L1)
code_block_5 = CodeBlock { true; }
allIndicesOf = List.AllIndicesOf(list=contains@L2, item=code_block_5)
getItemAtIndex = List.GetItemAtIndex(list=valueAtKey, index=allIndicesOf)
name = Element.Name(element=getItemAtIndex)
code_block_6 = CodeBlock { "FullWMCodeDescriptionPerElement"; }
valueAtKey_3 = DesignScript.Builtin.Dictionary.ValueAtKey(dictionary=code_block, key=code_block_6)
getItemAtIndex_2 = List.GetItemAtIndex(list=valueAtKey_3, index=allIndicesOf)
code_block_7 = CodeBlock(TargetElements=getItemAtIndex, TargetFamilyIndex=allIndicesOf, TargetFamilyCode=name, WMforTargetElements=getItemAtIndex_2)
# ---------- code_block_7.designscript (6 lines) ----------
{
"TargetElements": _TargetElements,
"TargetFamilyIndex": _TargetFamilyIndex,
"TargetFamilyCode": _TargetFamilyCode,
"WMforTargetElements": _WMforTargetElements
};
# ----------------------------------------
code_block_8 = CodeBlock { "TargetElements"; }
valueAtKey_4 = DesignScript.Builtin.Dictionary.ValueAtKey(dictionary=code_block_7, key=code_block_8)
code_block_9 = CodeBlock { "TargetFamilyCode"; }
valueAtKey_5 = DesignScript.Builtin.Dictionary.ValueAtKey(dictionary=code_block_7, key=code_block_9)
code_block_10 = CodeBlock { "WMforTargetElements"; }
valueAtKey_6 = DesignScript.Builtin.Dictionary.ValueAtKey(dictionary=code_block_7, key=code_block_10)
flatten = List.Flatten(list=valueAtKey_6)
uniqueItems_2 = List.UniqueItems(list=flatten)
watch_2 = Watch(uniqueItems_2)
code_block_11 = CodeBlock(TargetElements=valueAtKey_4, TargetFamilyCode=valueAtKey_5, WMforTargetElements=valueAtKey_6, TargetWMunique=watch_2)
# ---------- code_block_11.designscript (6 lines) ----------
{
"TargetElements": _TargetElements,
"TargetFamilyCode": _TargetFamilyCode,
"WMforTargetElements": _WMforTargetElements,
"TargetWMunique": _TargetWMunique
};
# ----------------------------------------

Dictionary = Output(code_block_11)
