# Dynamo custom node CreateGridPointOfBldgBoundary.dyf (Dynamo 2.10.1.3976)
# category: mQSpace
# CreateGridPointOfBldgBoundary

InputDic = Input(_InputDic: var[]..[])

# group: 룸 BoundingBox 그리드 포인트 생성
code_block = CodeBlock(InputDic=InputDic) { _InputDic; }
code_block_2 = CodeBlock { "BldgBoundary"; }
valueAtKey = DesignScript.Builtin.Dictionary.ValueAtKey(dictionary=code_block, key=code_block_2)
byGeometry = BoundingBox.ByGeometry(geom=valueAtKey)
minPoint = BoundingBox.MinPoint(boundingBox=byGeometry)
X = Point.X(point=minPoint)
maxPoint = BoundingBox.MaxPoint(boundingBox=byGeometry)
X_2 = Point.X(point=maxPoint)
code_block_3 = CodeBlock { 500; }
code_block_4 = CodeBlock(a=X, b=X_2, x=code_block_3) { a..b..x; }
Y = Point.Y(point=minPoint)
Y_2 = Point.Y(point=maxPoint)
code_block_5 = CodeBlock { 500; }
code_block_6 = CodeBlock(a=Y, b=Y_2, x=code_block_5) { a..b..x; }
byCoordinates = Point.ByCoordinates(x=code_block_4, y=code_block_6, lacing=CrossProduct)
flatten = List.Flatten(list=byCoordinates)
code_block_7 = CodeBlock(GridPointOfBldgBoundary=flatten)
# ---------- code_block_7.designscript (3 lines) ----------
{
"GridPointOfBldgBoundary": _GridPointOfBldgBoundary
};
# ----------------------------------------
extendsChildDictionaryFromParent = Custom[ExtendsChildDictionaryFromParent](ParentDic=code_block, ChildDic=code_block_7)  # Extends Child Dictionary From Parent

dictionary = Output(extendsChildDictionaryFromParent.dictionary)
