# Dynamo custom node DistributeRandomSeedForFixedPart.dyf (Dynamo 2.10.1.3976)
# category: mQSpace
# DistributeRandomSeedForFixedPart

InputDic = Input(_InputDic: var[]..[])

# group: Fixed Part 종류별 카운팅 및 Seed Random 값 부여
code_block = CodeBlock(InputDic=InputDic) { _InputDic; }
code_block_2 = CodeBlock { "BoxSeed(fixed)"; }
code_block_3 = CodeBlock { "BoxClass_Primary"; }
valueAtKey = DesignScript.Builtin.Dictionary.ValueAtKey(dictionary=code_block, key=code_block_3)
components = DesignScript.Builtin.Dictionary.Components(dictionary=valueAtKey)
watch = Watch(components.keys)
addItemToEnd = List.AddItemToEnd(item=code_block_2, list=watch)
code_block_4 = CodeBlock { "BoxDepartment"; }
valueAtKey_2 = DesignScript.Builtin.Dictionary.ValueAtKey(dictionary=valueAtKey, key=code_block_4)
code_block_5 = CodeBlock()
# ---------- code_block_5.designscript (6 lines) ----------
[
"PATHV1",
"PATHV2",
"PATHV3"
];
[];
# ----------------------------------------
contains = String.Contains(str=valueAtKey_2, searchFor=code_block_5.out0@@L1)
boolean = BoolSelector(true)
allIndicesOf = List.AllIndicesOf(list=contains@@L2, item=boolean)
count = List.Count(list=allIndicesOf@L3)
code_block_6 = CodeBlock { 0; }
code_block_7 = CodeBlock { "GridPointOfBldgBoundary"; }
valueAtKey_3 = DesignScript.Builtin.Dictionary.ValueAtKey(dictionary=code_block, key=code_block_7)
count_2 = List.Count(list=valueAtKey_3)
watch_2 = Watch(count_2)
code_block_8 = CodeBlock { "FixedPartSeed"; }
valueAtKey_4 = DesignScript.Builtin.Dictionary.ValueAtKey(dictionary=code_block, key=code_block_8)
randomList = Math.RandomList(amount=count, value1=code_block_6, value2=watch_2, seed=valueAtKey_4)
count_3 = List.Count(list=allIndicesOf@L2)
ofRepeatedItem = List.OfRepeatedItem(item=randomList@L1, amount=count_3@L1)
flatten = List.Flatten(list=ofRepeatedItem)
round = Math.Round(number=flatten)
transpose = List.Transpose(lists=components.values)
flatten_2 = List.Flatten(list=allIndicesOf)
list_getitematindex_fixed = List.GetItemAtIndex(list=transpose, index=flatten_2)
addItemToEnd_2 = List.AddItemToEnd(item=round@L1, list=list_getitematindex_fixed@L2)
transpose_2 = List.Transpose(lists=addItemToEnd_2)
byKeysValues = DesignScript.Builtin.Dictionary.ByKeysValues(keys=addItemToEnd, values=transpose_2)
code_block_9 = CodeBlock(BoxClass_fixedpart=byKeysValues)
# ---------- code_block_9.designscript (3 lines) ----------
{
"BoxClass_fixedpart": _BoxClass_fixedpart
};
# ----------------------------------------
extendsChildDictionaryFromParent = Custom[ExtendsChildDictionaryFromParent](ParentDic=code_block, ChildDic=code_block_9)  # Extends Child Dictionary From Parent

dictionary = Output(extendsChildDictionaryFromParent.dictionary)
