# Dynamo custom node DistributeRandomSeedForNonFixedPart.dyf (Dynamo 2.10.1.3976)
# category: mQSpace
# DistributeRandomSeedForNonFixedPart

InputDic = Input(_InputDic: var[]..[])

# group: Non-Fixed Part 레벨 별 Seed Random 값 부여
code_block = CodeBlock(InputDic=InputDic) { _InputDic; }
code_block_2 = CodeBlock { "BoxClass_nonfixedpart"; }
code_block_3 = CodeBlock { "BoxSeed(nonfixed)"; }
code_block_4 = CodeBlock { "BoxClass_nonfixedpart"; }
valueAtKey = DesignScript.Builtin.Dictionary.ValueAtKey(dictionary=code_block, key=code_block_4)
components = DesignScript.Builtin.Dictionary.Components(dictionary=valueAtKey)
addItemToEnd = List.AddItemToEnd(item=code_block_3, list=components.keys)
code_block_5 = CodeBlock { "BoxClass_nonfixedpart"; }
valueAtKey_2 = DesignScript.Builtin.Dictionary.ValueAtKey(dictionary=code_block, key=code_block_5)
code_block_6 = CodeBlock { "BoxLevel"; }
valueAtKey_3 = DesignScript.Builtin.Dictionary.ValueAtKey(dictionary=valueAtKey_2, key=code_block_6)
uniqueItems = List.UniqueItems(list=valueAtKey_3)
allIndicesOf = List.AllIndicesOf(list=valueAtKey_3, item=uniqueItems)
count = List.Count(list=allIndicesOf@L2)
code_block_7 = CodeBlock { 0; }
code_block_8 = CodeBlock { "RestGridPointByLevel"; }
valueAtKey_4 = DesignScript.Builtin.Dictionary.ValueAtKey(dictionary=code_block, key=code_block_8)
count_2 = List.Count(list=valueAtKey_4@L2)
count_3 = List.Count(list=allIndicesOf@L3)
code_block_9 = CodeBlock { 0; 999; }
code_block_10 = CodeBlock { "NonFixedPartSeed"; }
valueAtKey_5 = DesignScript.Builtin.Dictionary.ValueAtKey(dictionary=code_block, key=code_block_10)
randomList = Math.RandomList(amount=count_3, value1=code_block_9.out0, value2=code_block_9.out1, seed=valueAtKey_5)
flatten = List.Flatten(list=randomList)
randomList_2 = Math.RandomList(amount=count, value1=code_block_7, value2=count_2, seed=flatten)
flatten_2 = List.Flatten(list=randomList_2)
round = Math.Round(number=flatten_2)
components_2 = DesignScript.Builtin.Dictionary.Components(dictionary=valueAtKey_2)
transpose = List.Transpose(lists=components_2.values)
getItemAtIndex = List.GetItemAtIndex(list=transpose, index=allIndicesOf)
flatten_3 = List.Flatten(list=getItemAtIndex@L2)
addItemToEnd_2 = List.AddItemToEnd(item=round@L1, list=flatten_3@L2)
transpose_2 = List.Transpose(lists=addItemToEnd_2)
byKeysValues = DesignScript.Builtin.Dictionary.ByKeysValues(keys=addItemToEnd, values=transpose_2)
setValueAtKeys = DesignScript.Builtin.Dictionary.SetValueAtKeys(dictionary=code_block, keys=code_block_2, values=byKeysValues)

dictionary = Output(setValueAtKeys)
