# Dynamo custom node ExtractUnoccupiedGridPointsByLevel.dyf (Dynamo 2.10.1.3976)
# category: mQSpace
# ExtractUnoccupiedGridPointsByLevel

InputDic = Input(_InputDic: var[]..[])

# group: 레벨 별 고정부 비점유 포인트 추출
code_block = CodeBlock(InputDic=InputDic) { _InputDic; }
code_block_2 = CodeBlock { "GridPointOfBldgBoundary"; }
valueAtKey = DesignScript.Builtin.Dictionary.ValueAtKey(dictionary=code_block, key=code_block_2)
X = Point.X(point=valueAtKey)
Y = Point.Y(point=valueAtKey)
code_block_3 = CodeBlock { "BoxClass_fixedpart"; }
valueAtKey_2 = DesignScript.Builtin.Dictionary.ValueAtKey(dictionary=code_block, key=code_block_3)
code_block_4 = CodeBlock { "BoxZvalue"; }
valueAtKey_3 = DesignScript.Builtin.Dictionary.ValueAtKey(dictionary=valueAtKey_2, key=code_block_4)
uniqueItems = List.UniqueItems(list=valueAtKey_3)
byCoordinates = Point.ByCoordinates(x=X, y=Y, z=uniqueItems@L1)
code_block_5 = CodeBlock { "BoxGeometry"; }
valueAtKey_4 = DesignScript.Builtin.Dictionary.ValueAtKey(dictionary=valueAtKey_2, key=code_block_5)
byUnion = Solid.ByUnion(solids=valueAtKey_4)
doesIntersect = Geometry.DoesIntersect(geometry=byCoordinates, other=byUnion)
filterByBoolMask = List.FilterByBoolMask(list=byCoordinates@L2, mask=doesIntersect@L2)
watch = Watch(filterByBoolMask.out)
code_block_6 = CodeBlock(RestGridPointByLevel=watch)
# ---------- code_block_6.designscript (3 lines) ----------
{
"RestGridPointByLevel": _RestGridPointByLevel
};
# ----------------------------------------
extendsChildDictionaryFromParent = Custom[ExtendsChildDictionaryFromParent](ParentDic=code_block, ChildDic=code_block_6)  # Extends Child Dictionary From Parent

dictionary = Output(extendsChildDictionaryFromParent.dictionary)
