# Dynamo custom node PlaceFixedPartBoxBySeed.dyf (Dynamo 2.10.1.3976)
# category: mQSpace
# PlaceFixedPartBoxBySeed

InputDic = Input(_InputDic: var[]..[])

# group: Fixed Part 형상 배치 by Seed(회전 고려)
code_block = CodeBlock(InputDic=InputDic) { _InputDic; }
code_block_2 = CodeBlock { "BoxClass_fixedpart"; }
code_block_3 = CodeBlock { "BoxGeometry"; }
code_block_4 = CodeBlock { "BoxClass_fixedpart"; }
valueAtKey = DesignScript.Builtin.Dictionary.ValueAtKey(dictionary=code_block, key=code_block_4)
components = DesignScript.Builtin.Dictionary.Components(dictionary=valueAtKey)
addItemToEnd = List.AddItemToEnd(item=code_block_3, list=components.keys)
code_block_5 = CodeBlock { "GridPointOfBldgBoundary"; }
valueAtKey_2 = DesignScript.Builtin.Dictionary.ValueAtKey(dictionary=code_block, key=code_block_5)
code_block_6 = CodeBlock { "BoxSeed(fixed)"; }
valueAtKey_3 = DesignScript.Builtin.Dictionary.ValueAtKey(dictionary=valueAtKey, key=code_block_6)
getItemAtIndex = List.GetItemAtIndex(list=valueAtKey_2, index=valueAtKey_3)
X = Point.X(point=getItemAtIndex)
Y = Point.Y(point=getItemAtIndex)
code_block_7 = CodeBlock { "BoxZvalue"; }
valueAtKey_4 = DesignScript.Builtin.Dictionary.ValueAtKey(dictionary=valueAtKey, key=code_block_7)
firstItem = List.FirstItem(list=valueAtKey_4)
code_block_8 = CodeBlock(i=valueAtKey_4, j=firstItem) { i+Math.Abs(j/2); }
byCoordinates = Point.ByCoordinates(x=X, y=Y, z=code_block_8)
code_block_9 = CodeBlock { "BoxWidth"; }
valueAtKey_5 = DesignScript.Builtin.Dictionary.ValueAtKey(dictionary=valueAtKey, key=code_block_9)
code_block_10 = CodeBlock { "BoxLength"; }
valueAtKey_6 = DesignScript.Builtin.Dictionary.ValueAtKey(dictionary=valueAtKey, key=code_block_10)
code_block_11 = CodeBlock { "BoxHeight"; }
valueAtKey_7 = DesignScript.Builtin.Dictionary.ValueAtKey(dictionary=valueAtKey, key=code_block_11)
byLengths = Cuboid.ByLengths(origin=byCoordinates, width=valueAtKey_5, length=valueAtKey_6, height=valueAtKey_7)
centroid = Solid.Centroid(solid=byLengths)
ZAxis = Vector.ZAxis()
code_block_12 = CodeBlock { "BoxClass_Primary"; }
valueAtKey_8 = DesignScript.Builtin.Dictionary.ValueAtKey(dictionary=code_block, key=code_block_12)
code_block_13 = CodeBlock { "BoxDepartment"; }
valueAtKey_9 = DesignScript.Builtin.Dictionary.ValueAtKey(dictionary=valueAtKey_8, key=code_block_13)
code_block_14 = CodeBlock()
# ---------- code_block_14.designscript (6 lines) ----------
[
"PATHV1",
"PATHV2",
"PATHV3"
];
[];
# ----------------------------------------
contains = String.Contains(str=valueAtKey_9, searchFor=code_block_14.out0@@L1)
boolean = BoolSelector(true)
allIndicesOf = List.AllIndicesOf(list=contains@@L2, item=boolean)
count = List.Count(list=allIndicesOf)
code_block_15 = CodeBlock { 0; }
code_block_16 = CodeBlock { 90; }
code_block_17 = CodeBlock { "RotatingSeed"; }
valueAtKey_10 = DesignScript.Builtin.Dictionary.ValueAtKey(dictionary=code_block, key=code_block_17)
randomList = Math.RandomList(amount=count, value1=code_block_15, value2=code_block_16, seed=valueAtKey_10)
code_block_18 = CodeBlock(i=randomList) { i>=45; }
code_block_19 = CodeBlock { 90; 0; }
if_ = If(test=code_block_18, true=code_block_19.out0, false=code_block_19.out1)
count_2 = List.Count(list=allIndicesOf@L2)
ofRepeatedItem = List.OfRepeatedItem(item=if_@L1, amount=count_2@L1)
flatten = List.Flatten(list=ofRepeatedItem)
rotate = Geometry.Rotate(geometry=byLengths, origin=centroid, axis=ZAxis, degrees=flatten)
addItemToEnd_2 = List.AddItemToEnd(item=rotate, list=components.values)
byKeysValues = DesignScript.Builtin.Dictionary.ByKeysValues(keys=addItemToEnd, values=addItemToEnd_2)
setValueAtKeys = DesignScript.Builtin.Dictionary.SetValueAtKeys(dictionary=code_block, keys=code_block_2, values=byKeysValues)

dictionary = Output(setValueAtKeys)
