# Dynamo custom node PlaceNonFixedPartBoxBySeed.dyf (Dynamo 2.10.1.3976)
# category: mQSpace
# PlaceNonFixedPartBoxBySeed

InputDic = Input(_InputDic: var[]..[])

# group: Non-Fixed Part 형상 배치 by Seed(회전 고려)
code_block = CodeBlock(InputDic=InputDic) { _InputDic; }
code_block_2 = CodeBlock { "BoxClass_nonfixedpart"; }
code_block_3 = CodeBlock { "BoxGeometry"; }
code_block_4 = CodeBlock { "BoxClass_nonfixedpart"; }
valueAtKey = DesignScript.Builtin.Dictionary.ValueAtKey(dictionary=code_block, key=code_block_4)
components = DesignScript.Builtin.Dictionary.Components(dictionary=valueAtKey)
addItemToEnd = List.AddItemToEnd(item=code_block_3, list=components.keys)
code_block_5 = CodeBlock { "RestGridPointByLevel"; }
valueAtKey_2 = DesignScript.Builtin.Dictionary.ValueAtKey(dictionary=code_block, key=code_block_5)
code_block_6 = CodeBlock { "BoxSeed"; }
valueAtKey_3 = DesignScript.Builtin.Dictionary.ValueAtKey(dictionary=valueAtKey, key=code_block_6)
code_block_7 = CodeBlock { "BoxLevel"; }
valueAtKey_4 = DesignScript.Builtin.Dictionary.ValueAtKey(dictionary=valueAtKey, key=code_block_7)
uniqueItems = List.UniqueItems(list=valueAtKey_4)
allIndicesOf = List.AllIndicesOf(list=valueAtKey_4, item=uniqueItems)
count = List.Count(list=allIndicesOf@L2)
chop = List.Chop(list=valueAtKey_3, lengths=count)
getItemAtIndex = List.GetItemAtIndex(list=valueAtKey_2@L2, index=chop@L2)
X = Point.X(point=getItemAtIndex)
flatten = List.Flatten(list=X)
Y = Point.Y(point=getItemAtIndex)
flatten_2 = List.Flatten(list=Y)
code_block_8 = CodeBlock { "BoxZvalue"; }
valueAtKey_5 = DesignScript.Builtin.Dictionary.ValueAtKey(dictionary=valueAtKey, key=code_block_8)
firstItem = List.FirstItem(list=valueAtKey_5)
code_block_9 = CodeBlock(i=valueAtKey_5, j=firstItem) { i+Math.Abs(j/2); }
byCoordinates = Point.ByCoordinates(x=flatten, y=flatten_2, z=code_block_9)
flatten_3 = List.Flatten(list=byCoordinates)
code_block_10 = CodeBlock { "BoxWidth"; }
valueAtKey_6 = DesignScript.Builtin.Dictionary.ValueAtKey(dictionary=valueAtKey, key=code_block_10)
code_block_11 = CodeBlock { "BoxLength"; }
valueAtKey_7 = DesignScript.Builtin.Dictionary.ValueAtKey(dictionary=valueAtKey, key=code_block_11)
code_block_12 = CodeBlock { "BoxHeight"; }
valueAtKey_8 = DesignScript.Builtin.Dictionary.ValueAtKey(dictionary=valueAtKey, key=code_block_12)
byLengths = Cuboid.ByLengths(origin=flatten_3, width=valueAtKey_6, length=valueAtKey_7, height=valueAtKey_8)
centroid = Solid.Centroid(solid=byLengths)
ZAxis = Vector.ZAxis()
code_block_13 = CodeBlock { "BoxSpaceName"; }
valueAtKey_9 = DesignScript.Builtin.Dictionary.ValueAtKey(dictionary=valueAtKey, key=code_block_13)
count_2 = List.Count(list=valueAtKey_9)
code_block_14 = CodeBlock { 0; }
code_block_15 = CodeBlock { 90; }
code_block_16 = CodeBlock { "RotatingSeed"; }
valueAtKey_10 = DesignScript.Builtin.Dictionary.ValueAtKey(dictionary=code_block, key=code_block_16)
randomList = Math.RandomList(amount=count_2, value1=code_block_14, value2=code_block_15, seed=valueAtKey_10)
code_block_17 = CodeBlock(i=randomList) { i>=45; }
code_block_18 = CodeBlock { 90; 0; }
if_ = If(test=code_block_17, true=code_block_18.out0, false=code_block_18.out1)
flatten_4 = List.Flatten(list=if_)
rotate = Geometry.Rotate(geometry=byLengths, origin=centroid, axis=ZAxis, degrees=flatten_4)
addItemToEnd_2 = List.AddItemToEnd(item=rotate, list=components.values)
byKeysValues = DesignScript.Builtin.Dictionary.ByKeysValues(keys=addItemToEnd, values=addItemToEnd_2)
setValueAtKeys = DesignScript.Builtin.Dictionary.SetValueAtKeys(dictionary=code_block, keys=code_block_2, values=byKeysValues)

dictionary = Output(setValueAtKeys)
