# Dynamo custom node mQ_DataStructureTest1.dyf (Dynamo 2.11.1.4675)
# category: mQTest
# mQ_DataStructureTest1

# group: Data structure_Example
MemberName = Input(_MemberName: var[]..[])
code_block = CodeBlock(MemberName=MemberName)
# ---------- code_block.designscript (12 lines) ----------
_MemberName;
i=[Imperative]
{
	if (_MemberName == null)
	{
		return "none";
	}
	else
	{
		return _MemberName;
	}
};
# ----------------------------------------
ElementType = Input(_ElementType: var[]..[])
code_block_2 = CodeBlock(ElementType=ElementType)
# ---------- code_block_2.designscript (12 lines) ----------
_ElementType;
i=[Imperative]
{
	if (_ElementType == null)
	{
		return "none";
	}
	else
	{
		return _ElementType;
	}
};
# ----------------------------------------
Width = Input(_Width: var[]..[])
code_block_3 = CodeBlock(Width=Width)
# ---------- code_block_3.designscript (12 lines) ----------
_Width;
i=[Imperative]
{
	if (_Width == null)
	{
		return 1;
	}
	else
	{
		return _Width;
	}
};
# ----------------------------------------
Length = Input(_Length: var[]..[])
code_block_4 = CodeBlock(Length=Length)
# ---------- code_block_4.designscript (12 lines) ----------
_Length;
i=[Imperative]
{
	if (_Length == null)
	{
		return 1;
	}
	else
	{
		return _Length;
	}
};
# ----------------------------------------
Height = Input(_Height: var[]..[])
code_block_5 = CodeBlock(Height=Height)
# ---------- code_block_5.designscript (12 lines) ----------
_Height;
i=[Imperative]
{
	if (_Height == null)
	{
		return 1;
	}
	else
	{
		return _Height;
	}
};
# ----------------------------------------
Material = Input(_Material: var[]..[])
code_block_6 = CodeBlock(Material=Material) { _Material; }
Origin = Input(_Origin: Autodesk.DesignScript.Geometry.Point[]..[])
code_block_7 = CodeBlock(Origin=Origin)
# ---------- code_block_7.designscript (12 lines) ----------
_Origin;
i=[Imperative]
{
	if (_Origin == null)
	{
		return Point.Origin();
	}
	else
	{
		return _Origin;
	}
};
# ----------------------------------------
byLengths = Cuboid.ByLengths(origin=code_block_7.out1, width=code_block_3.out1, length=code_block_4.out1, height=code_block_5.out1)
area = Solid.Area(solid=byLengths)
volume = Solid.Volume(solid=byLengths)

centroid = Solid.Centroid(solid=byLengths)

# group (continued): Data structure_Example
code_block_8 = CodeBlock(memberName=code_block.out1, elementType=code_block_2.out1, width=code_block_3.out1, length=code_block_4.out1, height=code_block_5.out1, material=code_block_6, cuboid=byLengths, surfaceArea=area, volume=volume, location=centroid)
# ---------- code_block_8.designscript (12 lines) ----------
{
"MemberName": memberName,
"ElementType": elementType,
"Width": width,
"Length": length,
"Height": height,
"Material": material,
"Cuboid": cuboid,
"SurfaceArea": surfaceArea/1000000,
"Volume": volume/1000000000,
"Location": location
};
# ----------------------------------------
DataStructure = Output(code_block_8)
