# Dynamo graph openpyxl_test.dyn (Dynamo 2.10.1.3976)

python_script = Python()  # CPython3; unwired: IN[0]
# ---------- python_script.python (83 lines) ----------
# Load the Python Standard and DesignScript Libraries
import sys
sys.path.append(r'C:\Users\HEC\AppData\Local\Programs\Python\Python39\Lib\site-packages')
import clr
clr.AddReference('ProtoGeometry')
from Autodesk.DesignScript.Geometry import *
from collections import Iterable

def iterable(obj):
    return isinstance(obj, Iterable)


# The inputs to this node will be stored as a list in the IN variables.
dataEnteringNode = IN

# Place your code below this line
import datetime
import openpyxl

sample_items = [(datetime.datetime.strptime('2020-07-25', '%Y-%m-%d'), 'Product Name 1', 5, 10000),
                (datetime.datetime.strptime('2020-07-25', '%Y-%m-%d'), 'Product Name 2', 10, 3000),
                (datetime.datetime.strptime('2020-07-25', '%Y-%m-%d'), 'Product Name 3', 3, 7000)]


def write_to_file(filepath):
    wb = openpyxl.Workbook()
    for sheet in wb.sheetnames:
        wb.remove(wb[sheet])

    ws = wb.create_sheet(title='2020', index=0)

    ws.merge_cells('A1:F1')
    ws['A1'] = 'Inventory List'
    cell = ws['A1']
    cell.font = openpyxl.styles.Font(color='FFFFFF', size=20)
    cell.fill = openpyxl.styles.fills.PatternFill(patternType='solid',
                                                  fgColor=openpyxl.styles.colors.Color(rgb='ded697'))

    ws['A2'] = 'ID'
    ws['B2'] = 'Date in'
    ws['C2'] = 'Name'
    ws['D2'] = 'Quantity'
    ws['E2'] = 'Unit Price'
    ws['F2'] = 'Total'

    for col in range(ws.max_column):
        ws.column_dimensions[chr(ord('A') + col)].width = 15

    start_row = 3
    for (row, item) in enumerate(sample_items, start_row):
        ws.cell(row=row, column=1, value=row - 2)

        cell = ws.cell(row=row, column=2, value=item[0])
        cell.number_format = openpyxl.styles.numbers.FORMAT_DATE_YYYYMMDD2  # 'yyyy-mm-dd'

        ws.cell(row=row, column=3, value=item[1])

        cell = ws.cell(row=row, column=4, value=item[2])
        cell.number_format = openpyxl.styles.numbers.builtin_format_code(3)  # '#,##0'

        cell = ws.cell(row=row, column=5, value=item[3])
        cell.number_format = '#,##0'

        cell = ws.cell(row=row, column=6, value='= D{current_row} * E{current_row}'.format(current_row=cell.row))
        cell.number_format = openpyxl.styles.numbers.builtin_format_code(3)

    total_row = ws.max_row + 1
    if total_row > start_row:
        ws.cell(row=total_row, column=5, value='Total')
        cell = ws.cell(row=total_row, column=6, value='= SUM(F{}:F{})'.format(start_row, total_row - 1))
        cell.number_format = openpyxl.styles.numbers.builtin_format_code(3)

    wb.save(filepath)
    wb.close()


##if __name__ == '__main__':
#write_to_file('C:\\Users\\HEC\\Desktop\\test.xlsx')

a = chr(ord('A') + 1)

# Assign your output to the OUT variable.
OUT = a
# ----------------------------------------
categories = Categories("OST_Walls")
all_elements_of_category = ElementsOfCategory(Category=categories)
name = Element.Name(element=all_elements_of_category)
geometry = Element.Geometry(element=all_elements_of_category)
watch = Watch(geometry)
isEmpty = List.IsEmpty(list=watch@L2)
filterByBoolMask = List.FilterByBoolMask(list=name, mask=isEmpty)
code_block = CodeBlock(i=filterByBoolMask.out) { i; }
isEmpty_2 = List.IsEmpty(list=watch@L2)
filterByBoolMask_2 = List.FilterByBoolMask(list=all_elements_of_category, mask=isEmpty_2)
getMaterials = Element.GetMaterials(element=filterByBoolMask_2.out)
name_2 = Element.Name(element=getMaterials)
count = List.Count(list=name_2@L2)
ofRepeatedItem = List.OfRepeatedItem(item=code_block@L1, amount=count@L1)
watch_2 = Watch(ofRepeatedItem)
flatten = List.Flatten(list=watch_2)
watch_3 = Watch(name_2)
flatten_2 = List.Flatten(list=watch_3)
isEmpty_3 = List.IsEmpty(list=watch@L2)
filterByBoolMask_3 = List.FilterByBoolMask(list=watch, mask=isEmpty_3)
volume = Solid.Volume(solid=filterByBoolMask_3.out)
code_block_2 = CodeBlock(i=volume) { i/1000000000; }
flatten_3 = List.Flatten(list=code_block_2)
ofRepeatedItem_2 = List.OfRepeatedItem(item=flatten_3@L1, amount=count@L1)
watch_4 = Watch(ofRepeatedItem_2)
string_from_object = FromObject(object=watch_4)
flatten_4 = List.Flatten(list=string_from_object)
code_block_3 = CodeBlock(i=flatten, j=flatten_2, k=flatten_4) { i + "..." + j + "..." + k; }
code_block_4 = CodeBlock { "..."; }
split = String.Split(str=code_block_3, separator0=code_block_4)
watch_5 = Watch(split)
python_script_2 = Python(IN[0]=watch_5)  # CPython3
# ---------- python_script_2.python (107 lines) ----------
# Load the Python Standard and DesignScript Libraries
import sys
import os
#sys.path.append(r'C:\Users\HEC\AppData\Local\Programs\Python\Python39\Lib\site-packages')
#sys.path.append(r'C:\Users\pjmk0\AppData\Local\Programs\Python\Python39\Lib\site-packages')
sys.path.append(os.getenv('LOCALAPPDATA').replace('\\','\\\\') + r'\Programs\Python\Python39\Lib\site-packages')
import clr
clr.AddReference('ProtoGeometry')
from Autodesk.DesignScript.Geometry import *
from collections import Iterable

def iterable(obj):
    return isinstance(obj, Iterable)


# The inputs to this node will be stored as a list in the IN variables.
dataEnteringNode = IN
ListIn = IN[0]

# Place your code below this line
import datetime
import openpyxl
from openpyxl.styles import Border, Side, PatternFill, Font, GradientFill, Alignment

sample_items = ListIn


def write_to_file(filepath):
    wb = openpyxl.Workbook()
    for sheet in wb.sheetnames:
        wb.remove(wb[sheet])

    thin = Side(border_style="thin", color="000000")
    double = Side(border_style="double", color="000000")

    ws = wb.create_sheet(title='Wall_Calc_instance', index=0)

    ws.merge_cells('A1:E1')
    ws['A1'] = 'Wall Calculation Sheet'
    cell = ws['A1']
    cell.font = openpyxl.styles.Font(color='000000', size=20)
    cell.fill = openpyxl.styles.fills.PatternFill(patternType='solid',
                                                  fgColor=openpyxl.styles.colors.Color(rgb='fff3b0'))

    ws['A2'] = 'Item Number'
    ws['A2'].font = openpyxl.styles.Font(b=True, color='000000', size=11)
    ws['B2'] = 'Family Type'
    ws['B2'].font = openpyxl.styles.Font(b=True, color='000000', size=11)
    ws['C2'] = 'WorkMaster Code'
    ws['C2'].font = openpyxl.styles.Font(b=True, color='000000', size=11)
    ws['D2'] = 'Volume'
    ws['D2'].font = openpyxl.styles.Font(b=True, color='000000', size=11)
    ws['E2'] = 'Total Price'
    ws['E2'].font = openpyxl.styles.Font(b=True, color='000000', size=11)
#    ws['F2'] = 'Total'

## 칼럼별 너비 조정 구간
#    for col in range(ws.max_column):
#        ws.column_dimensions[chr(ord('A') + col)].width = 15
    ws.column_dimensions['A'].width = 15
    ws.column_dimensions['B'].width = 45
    ws.column_dimensions['C'].width = 60
    ws.column_dimensions['D'].width = 15
    ws.column_dimensions['E'].width = 15

###
    start_row = 3
    for (row, item) in enumerate(sample_items, start_row):
        cell = ws.cell(row=row, column=1, value=row - 2)
        cell.alignment = openpyxl.styles.Alignment(horizontal='center', vertical='center')

#        cell = ws.cell(row=row, column=2, value=item[0])
#        cell.number_format = openpyxl.styles.numbers.FORMAT_DATE_YYYYMMDD2  # 'yyyy-mm-dd'
        ws.cell(row=row, column=2, value=item[0]) ## Family Type 칼럼

        ws.cell(row=row, column=3, value=item[1]) ## WorkMaster Code 칼럼

        cell = ws.cell(row=row, column=4, value=item[2]) ## Volume 칼럼
        cell.number_format = openpyxl.styles.numbers.builtin_format_code(3)  # '#,##0'

        cell = ws.cell(row=row, column=5, value='= D{current_row} * 350'.format(current_row=cell.row))
        cell.number_format = '#,##0'

#        cell = ws.cell(row=row, column=6, value='= D{current_row} * E{current_row}'.format(current_row=cell.row))
#        cell.number_format = openpyxl.styles.numbers.builtin_format_code(3)

    total_row = ws.max_row + 1
    if total_row > start_row:
        cell1 = ws.cell(row=total_row, column=4, value='Total')
        cell1.font = openpyxl.styles.Font(b=True, color='000000', size=15)
        
        cell2 = ws.cell(row=total_row, column=5, value='= SUM(E{}:E{})'.format(start_row, total_row - 1))
        cell2.number_format = openpyxl.styles.numbers.builtin_format_code(3)
        cell2.border = Border(top=double, left=thin, right=thin, bottom=double)
        cell2.font = openpyxl.styles.Font(b=True, color='000000', size=15)
    

    wb.save(filepath)
    wb.close()


##if __name__ == '__main__':
#write_to_file('C:\\Users\\pjmk0\\AppData\\Roaming\\test.xlsx')
write_to_file(os.getenv('APPDATA').replace('\\','\\\\') + r'\test.xlsx')

# Assign your output to the OUT variable.
OUT = os.getenv('APPDATA')
# ----------------------------------------
