# Dynamo graph test1.dyn (Dynamo 2.11.1.4675)

code_block = CodeBlock { "..."; }

# group: excel import
file_path = Filename(".\BIM_물량집계 자동화 산출기준표_rC(20210607)_mk_de.xlsx")
file_from_path = FileObject(path=file_path)
code_block_2 = CodeBlock { "Scope_lv2(Walls)"; }
boolean = BoolSelector(false)
importExcel = Data.ImportExcel(file=file_from_path, sheetName=code_block_2, showExcel=boolean)

# group: null 값 처리
code_block_3 = CodeBlock { ""; }
isNull = Object.IsNull()  # unwired: object
replaceByCondition = Replace(item=importExcel, replaceWith=code_block_3, condition=isNull)

# group: whole data(row)
watch = Watch(replaceByCondition)

# group: col[0],[1],[2],[3] data(row)
number = DoubleInput(4)
takeItems = List.TakeItems(list=watch@L2, amount=number)
string_from_object = FromObject(object=takeItems)

join = String.Join(separator=code_block, string0=string_from_object)
watch_2 = Watch(join)

# group: whole data(column)
transpose = List.Transpose(lists=replaceByCondition)
watch_3 = Watch(transpose)

# group: row index guide
code_block_4 = CodeBlock(i=watch_3) { i[0]; }
watch_4 = Watch(code_block_4)

watch_5 = Watch(watch_3)

# group: column index guide
code_block_5 = CodeBlock(i=watch) { i[3]; }
watch_6 = Watch(code_block_5)

# group: 사용된 패밀리타입 column index 추출
string_from_object_2 = FromObject(object=watch_6)
code_block_6 = CodeBlock()
# ---------- code_block_6.designscript (6 lines) ----------
[
"WA311",
"WA221",
"CWW111",
"WA811"
];
# ----------------------------------------
contains = String.Contains(searchFor=code_block_6)  # unwired: string
map = List.Map(list=string_from_object_2, function=contains)
code_block_7 = CodeBlock { true; }

anyTrue = List.AnyTrue(list=map@L2)

# group (continued): 사용된 패밀리타입 column index 추출
allIndicesOf = List.AllIndicesOf(list=anyTrue@L2, item=code_block_7)

# group: 사용된 패밀리타입 column data 추출
identity = Object.Identity(object=allIndicesOf@L1)
getItemAtIndex = List.GetItemAtIndex(list=watch_5, index=identity)
watch_7 = Watch(getItemAtIndex)

identity_2 = Object.Identity(object=watch_7@L2)
transpose_2 = List.Transpose(lists=identity_2)
watch_8 = Watch(transpose_2)
