# Dynamo graph openpyxl_test.dyn (Dynamo 2.10.1.3976)

python_script = Python()  # CPython3; unwired: IN[0]
# ---------- python_script.python (83 lines) ----------
# Load the Python Standard and DesignScript Libraries
import sys
sys.path.append(r'C:\Users\pjmk0\AppData\Local\Programs\Python\Python39\Lib\site-packages')
import clr
clr.AddReference('ProtoGeometry')
from Autodesk.DesignScript.Geometry import *
from collections import Iterable

def iterable(obj):
    return isinstance(obj, Iterable)


# The inputs to this node will be stored as a list in the IN variables.
dataEnteringNode = IN

# Place your code below this line
import datetime
import openpyxl

sample_items = [(datetime.datetime.strptime('2020-07-25', '%Y-%m-%d'), 'Product Name 1', 5, 10000),
                (datetime.datetime.strptime('2020-07-25', '%Y-%m-%d'), 'Product Name 2', 10, 3000),
                (datetime.datetime.strptime('2020-07-25', '%Y-%m-%d'), 'Product Name 3', 3, 7000)]


def write_to_file(filepath):
    wb = openpyxl.Workbook()
    for sheet in wb.sheetnames:
        wb.remove(wb[sheet])

    ws = wb.create_sheet(title='2020', index=0)

    ws.merge_cells('A1:F1')
    ws['A1'] = 'Inventory List'
    cell = ws['A1']
    cell.font = openpyxl.styles.Font(color='FFFFFF', size=20)
    cell.fill = openpyxl.styles.fills.PatternFill(patternType='solid',
                                                  fgColor=openpyxl.styles.colors.Color(rgb='ded697'))

    ws['A2'] = 'ID'
    ws['B2'] = 'Date in'
    ws['C2'] = 'Name'
    ws['D2'] = 'Quantity'
    ws['E2'] = 'Unit Price'
    ws['F2'] = 'Total'

    for col in range(ws.max_column):
        ws.column_dimensions[chr(ord('A') + col)].width = 7

    start_row = 3
    for (row, item) in enumerate(sample_items, start_row):
        ws.cell(row=row, column=1, value=row - 2)

        cell = ws.cell(row=row, column=2, value=item[0])
        cell.number_format = openpyxl.styles.numbers.FORMAT_DATE_YYYYMMDD2  # 'yyyy-mm-dd'

        ws.cell(row=row, column=3, value=item[1])

        cell = ws.cell(row=row, column=4, value=item[2])
        cell.number_format = openpyxl.styles.numbers.builtin_format_code(3)  # '#,##0'

        cell = ws.cell(row=row, column=5, value=item[3])
        cell.number_format = '#,##0'

        cell = ws.cell(row=row, column=6, value='= D{current_row} * E{current_row}'.format(current_row=cell.row))
        cell.number_format = openpyxl.styles.numbers.builtin_format_code(3)

    total_row = ws.max_row + 1
    if total_row > start_row:
        ws.cell(row=total_row, column=5, value='Total')
        cell = ws.cell(row=total_row, column=6, value='= SUM(F{}:F{})'.format(start_row, total_row - 1))
        cell.number_format = openpyxl.styles.numbers.builtin_format_code(3)

    wb.save(filepath)
    wb.close()


##if __name__ == '__main__':
write_to_file('C:\\Users\\pjmk0\\test3.xlsx')

a = chr(ord('A') + 1)

# Assign your output to the OUT variable.
OUT = a
# ----------------------------------------
