# Dynamo graph Structural Member Auto Creation_Sample.dyn (Dynamo 2.10.1.3976)

# group: Excel: Data 추출
file_path = Filename(".\Sample.xlsx")
file_from_path = FileObject(path=file_path)
code_block = CodeBlock { "Sheet1"; }
boolean = BoolSelector(false)
importExcel = Data.ImportExcel(file=file_from_path, sheetName=code_block, showExcel=boolean)
code_block_2 = CodeBlock { 1; }
dropItems = List.DropItems(list=importExcel, amount=code_block_2)
watch = Watch(dropItems)

# group: Revit: Family Type 추출
code_block_3 = CodeBlock { 3; }
getItemAtIndex = List.GetItemAtIndex(list=watch@L2, index=code_block_3)
uniqueItems = List.UniqueItems(list=getItemAtIndex)
byName = Family.ByName(name=uniqueItems)
types = Family.Types(family=byName)
flatten = List.Flatten(list=types)

# group: Revit-Excel: Family Type 검색
string_from_object = FromObject(object=flatten)
code_block_4 = CodeBlock { 4; }
getItemAtIndex_2 = List.GetItemAtIndex(list=watch@L2, index=code_block_4)
contains = String.Contains(str=string_from_object, searchFor=getItemAtIndex_2, lacing=CrossProduct)
transpose = List.Transpose(lists=contains)
boolean_2 = BoolSelector(true)
allIndicesOf = List.AllIndicesOf(list=transpose@@L2, item=boolean_2@L1, lacing=CrossProduct)
flatten_2 = List.Flatten(list=allIndicesOf)
getItemAtIndex_3 = List.GetItemAtIndex(list=flatten, index=flatten_2)

# group: Revit: Grid 추출
categories = Categories("OST_Grids")
all_elements_of_category = ElementsOfCategory(Category=categories)
code_block_5 = CodeBlock { 3; }
chop = List.Chop(list=all_elements_of_category, lengths=code_block_5)

# group: Revit: Grid 정보 추출
curve = Grid.Curve(grid=chop)
firstItem = List.FirstItem(list=curve)
startPoint = Curve.StartPoint(curve=firstItem)
name = Element.Name(element=chop)
lastItem = List.LastItem(list=curve)
startPoint_2 = Curve.StartPoint(curve=lastItem)

# group: Revit: X축 그리드 정보 추출
X = Point.X(point=startPoint)
code_block_6 = CodeBlock(i=name) { i[0]; }

# group: Revit-Excel: X축 좌표 검색
string_from_object_2 = FromObject(object=code_block_6)
code_block_7 = CodeBlock { 0; }
getItemAtIndex_4 = List.GetItemAtIndex(list=watch@L2, index=code_block_7)
contains_2 = String.Contains(str=string_from_object_2, searchFor=getItemAtIndex_4, lacing=CrossProduct)
transpose_2 = List.Transpose(lists=contains_2)
boolean_3 = BoolSelector(true)
allIndicesOf_2 = List.AllIndicesOf(list=transpose_2@@L2, item=boolean_3@L1, lacing=CrossProduct)
flatten_3 = List.Flatten(list=allIndicesOf_2)
getItemAtIndex_5 = List.GetItemAtIndex(list=X, index=flatten_3)

# group: Revit: Y축 그리드 정보 추출
Y = Point.Y(point=startPoint_2)
code_block_8 = CodeBlock(i=name) { i[1]; }

# group: Revit-Excel: Y축 좌표 검색
string_from_object_3 = FromObject(object=code_block_8)
code_block_9 = CodeBlock { 1; }
getItemAtIndex_6 = List.GetItemAtIndex(list=watch@L2, index=code_block_9)
string_from_object_4 = FromObject(object=getItemAtIndex_6)
code_block_10 = CodeBlock { "."; }
split = String.Split(str=string_from_object_4, separator0=code_block_10)
firstItem_2 = List.FirstItem(list=split@L2)
contains_3 = String.Contains(str=string_from_object_3, searchFor=firstItem_2, lacing=CrossProduct)
transpose_3 = List.Transpose(lists=contains_3)
boolean_4 = BoolSelector(true)
allIndicesOf_3 = List.AllIndicesOf(list=transpose_3@@L2, item=boolean_4@L1, lacing=CrossProduct)
flatten_4 = List.Flatten(list=allIndicesOf_3)
getItemAtIndex_7 = List.GetItemAtIndex(list=Y, index=flatten_4)

byCoordinates = Point.ByCoordinates(x=getItemAtIndex_5, y=getItemAtIndex_7)

# group: Revit: Level 추출
categories_2 = Categories("OST_Levels")
all_elements_of_category_2 = ElementsOfCategory(Category=categories_2)

# group: Revit-Excel: Level 검색
string_from_object_5 = FromObject(object=all_elements_of_category_2)
code_block_11 = CodeBlock { 2; }
getItemAtIndex_8 = List.GetItemAtIndex(list=watch@L2, index=code_block_11)
contains_4 = String.Contains(str=string_from_object_5, searchFor=getItemAtIndex_8, lacing=CrossProduct)
transpose_4 = List.Transpose(lists=contains_4)
boolean_5 = BoolSelector(true)
allIndicesOf_4 = List.AllIndicesOf(list=transpose_4@@L2, item=boolean_5@L1, lacing=CrossProduct)
flatten_5 = List.Flatten(list=allIndicesOf_4)
getItemAtIndex_9 = List.GetItemAtIndex(list=all_elements_of_category_2, index=flatten_5)

byPointAndLevel = FamilyInstance.ByPointAndLevel(familyType=getItemAtIndex_3@L2, point=byCoordinates, level=getItemAtIndex_9)
parameters = Element.Parameters(element=chop)
