# Dynamo graph 4_RevitToExcel.dyn "Sample2_2021_0726" (Dynamo 2.10.1.3976)

code_block = CodeBlock { [" "," "]; }
code_block_2 = CodeBlock { "Base Level"; }
code_block_3 = CodeBlock { "Base Offset"; }
code_block_4 = CodeBlock { "Top Level"; }
code_block_5 = CodeBlock { "Top Offset"; }
code_block_6 = CodeBlock { "Column Location Mark"; }
code_block_7 = CodeBlock { "W11) Activity ID"; }
code_block_8 = CodeBlock { "W13) Plan Start Date"; }
join = List.Join(list0=code_block_2, list1=code_block_3, list2=code_block_4, list3=code_block_5, list4=code_block_6, list5=code_block_7, list6=code_block_8)
select_model_elements = DSModelElementsSelection()  # 1 picked in the model; graph input
code_block_9 = CodeBlock(input=select_model_elements) { _input; }
getParameterValueByName = Element.GetParameterValueByName(element=code_block_9, parameterName=code_block_2)
name = Element.Name(element=getParameterValueByName)
getParameterValueByName_2 = Element.GetParameterValueByName(element=code_block_9, parameterName=code_block_3)
getParameterValueByName_3 = Element.GetParameterValueByName(element=code_block_9, parameterName=code_block_4)
name_2 = Element.Name(element=getParameterValueByName_3)
getParameterValueByName_4 = Element.GetParameterValueByName(element=code_block_9, parameterName=code_block_5)
getParameterValueByName_5 = Element.GetParameterValueByName(element=code_block_9, parameterName=code_block_6)
getParameterValueByName_6 = Element.GetParameterValueByName(element=code_block_9, parameterName=code_block_7)
getParameterValueByName_7 = Element.GetParameterValueByName(element=code_block_9, parameterName=code_block_8)
join_2 = List.Join(list0=name, list1=getParameterValueByName_2, list2=name_2, list3=getParameterValueByName_4, list4=getParameterValueByName_5, list5=getParameterValueByName_6, list6=getParameterValueByName_7)
list_create = List.Create(item0=join, item1=join_2)
transpose = List.Transpose(lists=list_create)
addItemToEnd = List.AddItemToEnd(item=code_block@L2, list=transpose@L2, lacing=CrossProduct)
flatten = List.Flatten(list=addItemToEnd@L3)
string_from_object = FromObject(object=flatten)
code_block_10 = CodeBlock { ""; }
code_block_11 = CodeBlock { 4; }
ofRepeatedItem = List.OfRepeatedItem(item=code_block_10, amount=code_block_11)
code_block_12 = CodeBlock { 4; }
chop = List.Chop(list=ofRepeatedItem, lengths=code_block_12)  # graph output
code_block_13 = CodeBlock { "South Surface Area"; }
code_block_14 = CodeBlock { "hec_material1"; }
getParameterValueByName_8 = Element.GetParameterValueByName(element=select_model_elements, parameterName=code_block_14)
name_3 = Element.Name(element=getParameterValueByName_8)
faces = Element.Faces(element=select_model_elements)
code_block_15 = CodeBlock(i=faces) { i[3]; }
area = Surface.Area(surface=code_block_15)
code_block_16 = CodeBlock(i=area) { i/1000000; }
code_block_17 = CodeBlock { "M2"; }
join_3 = List.Join(list0=code_block_13, list1=name_3, list2=code_block_16, list3=code_block_17)
code_block_18 = CodeBlock { 4; }
chop_2 = List.Chop(list=join_3, lengths=code_block_18)  # graph output
list_create_2 = List.Create(item0=string_from_object, item1=chop, item2=chop_2)
flatten_2 = List.Flatten(list=list_create_2@L2)
python_script_export_excel_by = Python(IN[0]=flatten_2)  # "Python Script@Export Excel(By OpenpyXl)"; CPython3; frozen
# ---------- python_script_export_excel_by.python (151 lines) ----------
# Load the Python Standard and DesignScript Libraries
import sys
import os
#sys.path.append(r'C:\Users\HEC\AppData\Local\Programs\Python\Python39\Lib\site-packages')
#sys.path.append(r'C:\Users\pjmk0\AppData\Local\Programs\Python\Python39\Lib\site-packages')
sys.path.append(os.getenv('LOCALAPPDATA').replace('\\','\\\\') + r'\Programs\Python\Python39\Lib\site-packages')
import clr
clr.AddReference('ProtoGeometry')
from Autodesk.DesignScript.Geometry import *
from collections import Iterable

def iterable(obj):
    return isinstance(obj, Iterable)


# The inputs to this node will be stored as a list in the IN variables.
dataEnteringNode = IN
ListIn = IN[0]

# Place your code below this line
import datetime
from datetime import date, timedelta
Today = date.today()
import openpyxl
from openpyxl.styles import Border, Side, PatternFill, Font, GradientFill, Alignment, Color, numbers

sample_items = ListIn


def write_to_file(filepath):
    wb = openpyxl.Workbook()
    for sheet in wb.sheetnames:
        wb.remove(wb[sheet])

    thin = Side(border_style="thin", color="000000")
    double = Side(border_style="double", color="000000")

    ws = wb.create_sheet(title='Wall_Calc_instance', index=0)

    ws.merge_cells('A1:L1')
    ws['A1'] = 'HEC Wall Category Calculation Sheet'
    cell = ws['A1']
    cell.font = openpyxl.styles.Font(color='000000', size=20)
    cell.fill = openpyxl.styles.fills.PatternFill(patternType='solid',
                                                  fgColor=openpyxl.styles.colors.Color(rgb='fff3b0'))

    ws['A2'] = ''#'Item Number'
    ws['A2'].font = openpyxl.styles.Font(b=True, color='000000', size=12)
    #ws['B2'] = 'Member Name'
    #ws['B2'].font = openpyxl.styles.Font(b=True, color='000000', size=12)
    #ws['C2'] = 'Category'
    #ws['C2'].font = openpyxl.styles.Font(b=True, color='000000', size=12)
    ws['B2'] = ''#'Family Type'
    ws['B2'].font = openpyxl.styles.Font(b=True, color='000000', size=12)
    ws['C2'] = ''#'WorkMaster Code'
    ws['C2'].font = openpyxl.styles.Font(b=True, color='000000', size=12)
    #ws['F2'] = 'WorkMaster Description'
    #ws['F2'].font = openpyxl.styles.Font(b=True, color='000000', size=12)
    #ws['G2'] = 'Unit'
    #ws['G2'].font = openpyxl.styles.Font(b=True, color='000000', size=12)
    #ws['H2'] = '계수'
    #ws['H2'].font = openpyxl.styles.Font(b=True, color='000000', size=12)
    #ws['I2'] = '계산 참조값'
    #ws['I2'].font = openpyxl.styles.Font(b=True, color='000000', size=12)
    ws['D2'] = ''#'Quantities'
    ws['D2'].font = openpyxl.styles.Font(b=True, color='000000', size=12)
    ws['E2'] = ''#'Unit'
    ws['E2'].font = openpyxl.styles.Font(b=True, color='000000', size=12)
    ws['F2'] = ''#'Unit Price'
    ws['F2'].font = openpyxl.styles.Font(b=True, color='000000', size=12)
    ws['G2'] = ''#'Total Price'
    ws['G2'].font = openpyxl.styles.Font(b=True, color='000000', size=12)


## 칼럼별 너비 조정 구간
#    for col in range(ws.max_column):
#        ws.column_dimensions[chr(ord('A') + col)].width = 15
    ws.column_dimensions['A'].width = 15
    ws.column_dimensions['B'].width = 45
    ws.column_dimensions['C'].width = 60
    ws.column_dimensions['D'].width = 20
    ws.column_dimensions['E'].width = 20
    ws.column_dimensions['F'].width = 20
    ws.column_dimensions['G'].width = 20
    #ws.column_dimensions['G'].width = 9
    #ws.column_dimensions['H'].width = 9
    #ws.column_dimensions['H'].hidden = True
    #ws.column_dimensions['I'].width = 12
    #ws.column_dimensions['I'].hidden = True
    #ws.column_dimensions['J'].width = 12
    #ws.column_dimensions['K'].width = 12
    #ws.column_dimensions['L'].width = 12

###
    start_row = 3
    for (row, item) in enumerate(sample_items, start_row):
        cell = ws.cell(row=row, column=1, value=row - 2)
        cell.alignment = openpyxl.styles.Alignment(horizontal='center', vertical='center')

#        cell = ws.cell(row=row, column=2, value=item[0])
#        cell.number_format = openpyxl.styles.numbers.FORMAT_DATE_YYYYMMDD2  # 'yyyy-mm-dd'
        ws.cell(row=row, column=2, value=item[0]) ## Family Type 칼럼

        ws.cell(row=row, column=3, value=item[1]) ## WorkMaster Code 칼럼
        
        ws.cell(row=row, column=4, value=item[2]) ## Quantities 칼럼
        
        ws.cell(row=row, column=5, value=item[3]) ## Unit 칼럼
        
        #cell = ws.cell(row=row, column=8, value=item[6]) ## 계수 칼럼
        #cell.number_format = openpyxl.styles.numbers.builtin_format_code(3)  # '#,##0'
        
        #cell = ws.cell(row=row, column=9, value=item[7]) ## 계산 참조값 칼럼
        #cell.number_format = openpyxl.styles.numbers.builtin_format_code(3)  # '#,##0'
        
        #cell = ws.cell(row=row, column=10, value=item[8]) ## Quantities 칼럼
        #cell.number_format = openpyxl.styles.numbers.builtin_format_code(3)  # '#,##0'
        #cell.font = openpyxl.styles.Font(b=True, color='000000', size=11)

        #cell = ws.cell(row=row, column=7, value=''#'= D{current_row}*F{current_row}'.format(current_row=cell.row))
        #cell.number_format = '#,##0'

#        cell = ws.cell(row=row, column=6, value='= D{current_row} * E{current_row}'.format(current_row=cell.row))
#        cell.number_format = openpyxl.styles.numbers.builtin_format_code(3)

    #total_row = ws.max_row + 1
    #if total_row > start_row:
        #cell1 = ws.cell(row=total_row, column=6, value=''#'Total')
        #cell1.font = openpyxl.styles.Font(b=True, color='000000', size=15)
        
        #cell2 = ws.cell(row=total_row, column=7, value=''#'= SUM(G{}:G{})'.format(start_row, total_row - 1))
        #cell2.number_format = openpyxl.styles.numbers.builtin_format_code(3)
        #cell2.border = Border(top=double, left=double, right=double, bottom=double)
        #cell2.font = openpyxl.styles.Font(b=True, color='ff03ce', size=15)
    

    wb.save(filepath)
    wb.close()


##if __name__ == '__main__':
#write_to_file('C:\\Users\\pjmk0\\AppData\\Roaming\\test.xlsx')

save_name = "HecSampleSheet_" + Today.strftime("%Y-%m-%d")+".xlsx"
path = os.getenv('APPDATA').replace('\\','\\\\')
filePath = path + '\\' + save_name

write_to_file(filePath)

# Assign your output to the OUT variable.
OUT = os.getenv('APPDATA')
# ----------------------------------------
perimeterCurves = Surface.PerimeterCurves(surface=faces)
