# Dynamo graph Str Foundation Calculator_DataStructureTest(1005)_mk.dyn (Dynamo 2.10.1.3976)

# note: 되메우기기

# group: Example
code_block = CodeBlock { ["a","b","c"]; [1,2,3]; }
byKeysValues = DesignScript.Builtin.Dictionary.ByKeysValues(keys=code_block.out0, values=code_block.out1)
code_block_2 = CodeBlock { ["d","e","f"]; [4,5,6]; }
byKeysValues_2 = DesignScript.Builtin.Dictionary.ByKeysValues(keys=code_block_2.out0, values=code_block_2.out1)
code_block_3 = CodeBlock(a1=byKeysValues, b1=byKeysValues_2)
# ---------- code_block_3.designscript (4 lines) ----------
{
"a1": a1
,"b1": b1
};
# ----------------------------------------
code_block_4 = CodeBlock { "a1"; }
valueAtKey = DesignScript.Builtin.Dictionary.ValueAtKey(dictionary=code_block_3, key=code_block_4)
code_block_5 = CodeBlock { "a"; }
valueAtKey_2 = DesignScript.Builtin.Dictionary.ValueAtKey(dictionary=valueAtKey, key=code_block_5)

code_block_6 = CodeBlock { "TargetElements"; }
valueAtKey_3 = DesignScript.Builtin.Dictionary.ValueAtKey(key=code_block_6)  # unwired: dictionary
# note: <Func>
createBaseCourseSurfaces = Custom[CreateBaseCourseSurfaces](Element=valueAtKey_3)  # CreateBaseCourseSurfaces

# group: Primary Input
categories = Categories("OST_StructuralFoundation")
all_elements_of_category = ElementsOfCategory(Category=categories)
file_path = Filename("..\Laboratory\20210928_kcs 에러\BIM_물량집계 자동화 산출기준표_rC(20210903).xlsx")
file_from_path = FileObject(path=file_path)
code_block_7 = CodeBlock { "Str Foundations"; }

# group: GetFull WMCodeDescription PerElement
getFullWMCodeDescriptionPerElement = Custom[GetFullWMCodeDescriptionPerElement](InputElement=all_elements_of_category, InputFilePath=file_from_path, InputSheetName=code_block_7)  # GetFullWMCodeDescriptionPerElement

# group: OrganizeAllElementInformAsDictionary
organizeAllElementInformAsDictionary = Custom[OrganizeAllElementInformAsDictionary](InputDic=getFullWMCodeDescriptionPerElement.Dictionary)  # OrganizeAllElementInformAsDictionary

# group: Select Target Family Element And Connected WorkMasters
code_block_8 = CodeBlock { 0; }
selectTargetFamilyInformAsDictionary = Custom[SelectTargetFamilyInformAsDictionary](InputDic=organizeAllElementInformAsDictionary, InputIndex=code_block_8)  # Select Target Family Element And Connected WorkMasters

value_for_import_from_others = CodeBlock(MainInput=selectTargetFamilyInformAsDictionary) { MainInput; RefInput; }  # unwired: RefInput

# group: <Func 5'> Lean Concrete
code_block_9 = CodeBlock { "TargetElements"; }
valueAtKey_4 = DesignScript.Builtin.Dictionary.ValueAtKey(dictionary=value_for_import_from_others.MainInput, key=code_block_9)
# note: <Func>
createLeanConcrete = Custom[CreateLeanConcrete](Element=valueAtKey_4)  # CreateLeanConcreteForISOFDN
flatten = List.Flatten(list=createLeanConcrete.Solid)
value_for_export_to_others = CodeBlock(린콘크리트형상=flatten) { 린콘크리트형상; }
volume = Solid.Volume(solid=createLeanConcrete.Solid)
code_block_10 = CodeBlock(i=volume) { Math.Round(List.Flatten(i)/1000000000, 2); }
code_block_11 = CodeBlock { "M3"; }
count = List.Count(list=code_block_10)
ofRepeatedItem = List.OfRepeatedItem(item=code_block_11, amount=count)
code_block_12 = CodeBlock(FuncValues=code_block_10, FuncValuesUnit=ofRepeatedItem)
# ---------- code_block_12.designscript (4 lines) ----------
{
"FuncValues": _FuncValues,
"FuncValuesUnit": _FuncValuesUnit
};
# ----------------------------------------

value_for_import_from_others_2 = CodeBlock(MainInput=selectTargetFamilyInformAsDictionary, RefInput=value_for_export_to_others) { MainInput; RefInput; }

# group: <Func 1-1> Excavation by IsoFDN
하부_surface_추출 = Python(IN[0]=value_for_import_from_others_2.RefInput)  # CPython3
# ---------- 하부_surface_추출.python (26 lines) ----------
# Load the Python Standard and DesignScript Libraries
import sys
import clr
import itertools
clr.AddReference('ProtoGeometry')
from Autodesk.DesignScript.Geometry import *

# The inputs to this node will be stored as a list in the IN variables.
dataEnteringNode = IN
input_elements = IN[0]

# Place your code below this line

srfs_input_elements = list(map(lambda x: x.Explode(), input_elements))

#srfs_input_flatten = list(itertools.chain(*srfs_input_elements))

def func_findZ_normalAtParma(srf):
    return srf.NormalAtParameter(0.5,0.5).Z
srfs_below = list(map(lambda y: filter(lambda x: func_findZ_normalAtParma(x) == -1, y), srfs_input_elements))

result = srfs_below


# Assign your output to the OUT variable.
OUT = result
# ----------------------------------------
flatten_2 = List.Flatten(list=하부_surface_추출)
perimeterCurves = Surface.PerimeterCurves(surface=flatten_2)
byJoinedCurves = PolyCurve.ByJoinedCurves(curves=perimeterCurves)
code_block_13 = CodeBlock { _ExcavOffsetBottom: var[]..[] = 300; }
offset = Curve.Offset(curve=byJoinedCurves, distance=code_block_13)
flatten_3 = List.Flatten(list=offset)
levels = Levels("G.L")  # graph input
elevation = Level.Elevation(level=levels)
code_block_14 = CodeBlock { "TargetElements"; }
valueAtKey_5 = DesignScript.Builtin.Dictionary.ValueAtKey(dictionary=value_for_import_from_others_2.MainInput, key=code_block_14)
code_block_15 = CodeBlock { "Elevation at Bottom"; }
getParameterValueByName = Element.GetParameterValueByName(element=valueAtKey_5, parameterName=code_block_15)
린_콘크리트_하부까지의_길이_추출_최하단 = Python(IN[0]=value_for_import_from_others_2.RefInput)  # CPython3
# ---------- 린_콘크리트_하부까지의_길이_추출_최하단.python (22 lines) ----------
# Load the Python Standard and DesignScript Libraries
import sys
import clr
clr.AddReference('ProtoGeometry')
from Autodesk.DesignScript.Geometry import *

# The inputs to this node will be stored as a list in the IN variables.
dataEnteringNode = IN
inputs = IN[0]

# Place your code below this line

def findThickness(i):
    minPt_Z = BoundingBox.ByGeometry(i).MinPoint.Z
    maxPt_Z = BoundingBox.ByGeometry(i).MaxPoint.Z
    result = maxPt_Z - minPt_Z
    return result

thicknessByInput = list(map(findThickness, inputs))

# Assign your output to the OUT variable.
OUT = thicknessByInput
# ----------------------------------------
code_block_16 = CodeBlock(기초하단=getParameterValueByName, 린콘크리트하단=린_콘크리트_하부까지의_길이_추출_최하단) { 기초하단-린콘크리트하단; }
sub = elevation - code_block_16
code_block_17 = CodeBlock { 0; }
isNull = Object.IsNull()  # unwired: object
replaceByCondition = Replace(item=sub, replaceWith=code_block_17, condition=isNull)
flatten_4 = List.Flatten(list=replaceByCondition)
translate = Geometry.Translate(geometry=offset, zTranslation=flatten_4)
경사_비율_입력_1_x = DoubleInput(2)  # graph input
code_block_18 = CodeBlock(ElevationatBottom=flatten_4, 비율=경사_비율_입력_1_x) { ElevationatBottom/비율; }
offset_2 = Curve.Offset(curve=translate, distance=code_block_18)
flatten_5 = List.Flatten(list=offset_2)
list_create = List.Create(item0=flatten_3, item1=flatten_5)
transpose = List.Transpose(lists=list_create)
byLoft = Solid.ByLoft(crossSections=transpose)
터파기_형상_겹침_해소 = Python(IN[0]=byLoft)  # CPython3
# ---------- 터파기_형상_겹침_해소.python (29 lines) ----------
# Load the Python Standard and DesignScript Libraries
import sys
import clr
clr.AddReference('ProtoGeometry')
from Autodesk.DesignScript.Geometry import *

# The inputs to this node will be stored as a list in the IN variables.
dataEnteringNode = IN
inputs = IN[0]
result = []
# Place your code below this line

for x in range(len(inputs)):
    if x < len(inputs)-1:
        temp = []
        apply = inputs[x]
        for y in range(x,len(inputs)):
            if apply.DoesIntersect(inputs[y]):
                apply = apply.Split(inputs[y])[0]
                temp.append(apply)
            else:
                apply = apply
                temp.append(apply)
        result.append(temp[-1])
    elif x == len(inputs)-1:
        result.append(inputs[x])

# Assign your output to the OUT variable.
OUT = result
# ----------------------------------------
volume_2 = Solid.Volume(solid=터파기_형상_겹침_해소)
code_block_19 = CodeBlock(i=volume_2) { Math.Round(List.Flatten(i)/1000000000, 2); }
code_block_20 = CodeBlock { "M3"; }
count_2 = List.Count(list=code_block_19)
ofRepeatedItem_2 = List.OfRepeatedItem(item=code_block_20, amount=count_2)
code_block_21 = CodeBlock(FuncValues=code_block_19, FuncValuesUnit=ofRepeatedItem_2)  # same code as code_block_12
color_palette = ColorPalette({R: 210, G: 105, B: 30, A: 135})
byGeometryColor = Modifiers.GeometryColor.ByGeometryColor(geometry=터파기_형상_겹침_해소, color=color_palette)
forRefOutput = CodeBlock(MainOutput=code_block_21, geoColor=byGeometryColor, 터파기형상=터파기_형상_겹침_해소)
# ---------- forRefOutput.designscript (5 lines) ----------
{
"MainOutput": MainOutput,
"geoColor": geoColor,
"터파기형상": 터파기형상
};
# ----------------------------------------

# group: <Func 1-2> Excavation by Overall
하부_surface_추출_2 = Python(IN[0]=value_for_import_from_others_2.RefInput)  # CPython3; same code as 하부_surface_추출
flatten_6 = List.Flatten(list=하부_surface_추출_2)
byGeometry = BoundingBox.ByGeometry(geom=flatten_6)
toCuboid = BoundingBox.ToCuboid(boundingBox=byGeometry)
code_block_22 = CodeBlock(i=toCuboid) { [i]; }
하부_surface_추출_3 = Python(IN[0]=code_block_22)  # CPython3; same code as 하부_surface_추출
perimeterCurves_2 = Surface.PerimeterCurves(surface=하부_surface_추출_3)
byJoinedCurves_2 = PolyCurve.ByJoinedCurves(curves=perimeterCurves_2)
code_block_23 = CodeBlock { _ExcavOffsetBottom: var[]..[] = 300; }
offset_3 = Curve.Offset(curve=byJoinedCurves_2, distance=code_block_23)
flatten_7 = List.Flatten(list=offset_3)
levels_2 = Levels("G.L")  # graph input
elevation_2 = Level.Elevation(level=levels_2)
code_block_24 = CodeBlock { "TargetElements"; }
valueAtKey_6 = DesignScript.Builtin.Dictionary.ValueAtKey(dictionary=value_for_import_from_others_2.MainInput, key=code_block_24)
code_block_25 = CodeBlock { "Elevation at Bottom"; }
getParameterValueByName_2 = Element.GetParameterValueByName(element=valueAtKey_6, parameterName=code_block_25)
린_콘크리트_하부까지의_길이_추출_최하단_2 = Python(IN[0]=value_for_import_from_others_2.RefInput)  # CPython3; same code as 린_콘크리트_하부까지의_길이_추출_최하단
code_block_26 = CodeBlock(기초하단=getParameterValueByName_2, 린콘크리트하단=린_콘크리트_하부까지의_길이_추출_최하단_2) { 기초하단-린콘크리트하단; }
uniqueItems = List.UniqueItems(list=code_block_26@L2)
sub_2 = elevation_2 - uniqueItems
code_block_27 = CodeBlock { 0; }
isNull_2 = Object.IsNull()  # unwired: object
replaceByCondition_2 = Replace(item=sub_2, replaceWith=code_block_27, condition=isNull_2)
flatten_8 = List.Flatten(list=replaceByCondition_2)
translate_2 = Geometry.Translate(geometry=offset_3, zTranslation=flatten_8)
경사_비율_입력_1_x_2 = DoubleInput(2)  # graph input
code_block_28 = CodeBlock(ElevationatBottom=flatten_8, 비율=경사_비율_입력_1_x_2) { ElevationatBottom/비율; }
offset_4 = Curve.Offset(curve=translate_2, distance=code_block_28)
flatten_9 = List.Flatten(list=offset_4)
list_create_2 = List.Create(item0=flatten_7, item1=flatten_9)
transpose_2 = List.Transpose(lists=list_create_2)
byLoft_2 = Solid.ByLoft(crossSections=transpose_2)
터파기_형상_겹침_해소_2 = Python(IN[0]=byLoft_2)  # CPython3; same code as 터파기_형상_겹침_해소
volume_3 = Solid.Volume(solid=터파기_형상_겹침_해소_2)
code_block_29 = CodeBlock(i=volume_3) { Math.Round(List.Flatten(i)/1000000000, 2); }
code_block_30 = CodeBlock { "M3"; }
count_3 = List.Count(list=code_block_29)
ofRepeatedItem_3 = List.OfRepeatedItem(item=code_block_30, amount=count_3)
code_block_31 = CodeBlock(FuncValues=code_block_29, FuncValuesUnit=ofRepeatedItem_3)  # same code as code_block_12
color_palette_2 = ColorPalette({R: 210, G: 105, B: 30, A: 135})
byGeometryColor_2 = Modifiers.GeometryColor.ByGeometryColor(geometry=터파기_형상_겹침_해소_2, color=color_palette_2)
forRefOutput_2 = CodeBlock(MainOutput=code_block_31, geoColor=byGeometryColor_2, 터파기형상=터파기_형상_겹침_해소_2)  # same code as forRefOutput

# group: 함수 선택
터파기_산출_타입_선택_iso_or_overall = StringInput("iso")  # graph input
code_block_32 = CodeBlock(functionName=터파기_산출_타입_선택_iso_or_overall) { functionName == "iso"? true:false; }
if_ = If(test=code_block_32, true=forRefOutput, false=forRefOutput_2)

code_block_33 = CodeBlock { "MainOutput"; }
valueAtKey_7 = DesignScript.Builtin.Dictionary.ValueAtKey(dictionary=if_, key=code_block_33)
code_block_34 = CodeBlock { "터파기형상"; }
valueAtKey_8 = DesignScript.Builtin.Dictionary.ValueAtKey(dictionary=if_, key=code_block_34)
code_block_35 = CodeBlock { "geoColor"; }
valueAtKey_9 = DesignScript.Builtin.Dictionary.ValueAtKey(dictionary=if_, key=code_block_35)
code_block_36 = CodeBlock(MainOutput=valueAtKey_7, RefOutput_터파기형상=valueAtKey_8, RefOutput_geoColor=valueAtKey_9) { MainOutput; RefOutput_터파기형상; RefOutput_geoColor; }
code_block_37 = CodeBlock { "TargetElements"; }
valueAtKey_10 = DesignScript.Builtin.Dictionary.ValueAtKey(key=code_block_37)  # unwired: dictionary
extractSideFacesOfElement = Custom[ExtractSideFacesOfElement](Element=valueAtKey_10)  # ExtractSideFacesOfElement
code_block_38 = CodeBlock { "TargetElements"; }
valueAtKey_11 = DesignScript.Builtin.Dictionary.ValueAtKey(key=code_block_38)  # unwired: dictionary

# group: <Func 7_Algorism> 측면 + 상부면 중 pedestal 점유면적 제외
code_block_39 = CodeBlock(Element=valueAtKey_11) { _Element; }
extractUpperFacesOfElement = Custom[ExtractUpperFacesOfElement](Element=code_block_39)  # ExtractUpperFacesOfElement
flatten_10 = List.Flatten(list=extractUpperFacesOfElement.Surface)
getJoinedElements = Element.GetJoinedElements(element=code_block_39)
flatten_11 = List.Flatten(list=getJoinedElements)
extractBelowFacesOfElement = Custom[ExtractBelowFacesOfElement](Element=flatten_11)  # ExtractBelowFacesOfElement
flatten_12 = List.Flatten(list=extractBelowFacesOfElement.Surface)
doesIntersect = Geometry.DoesIntersect(geometry=flatten_12, other=flatten_10, lacing=CrossProduct)
code_block_40 = CodeBlock { true; }
allIndicesOf = List.AllIndicesOf(list=doesIntersect@L2, item=code_block_40)
flatten_13 = List.Flatten(list=allIndicesOf)
groupByKey = List.GroupByKey(list=flatten_12, keys=flatten_13)
difference = Surface.Difference(surface=flatten_10, others=groupByKey.groups)
extractSideFacesOfElement_2 = Custom[ExtractSideFacesOfElement](Element=code_block_39)
addItemToFront = List.AddItemToFront(item=difference@L1, list=extractSideFacesOfElement_2.Surface@L2)
color_palette_3 = ColorPalette({R: 30, G: 144, B: 255, A: 129})
byGeometryColor_3 = Modifiers.GeometryColor.ByGeometryColor(geometry=addItemToFront, color=color_palette_3)

# group: See Result
code_block_41 = CodeBlock(SeeResult=createBaseCourseSurfaces.GeometryColor) { SeeResult; }
code_block_42 = CodeBlock(SeeResult=code_block_36.RefOutput_geoColor) { SeeResult; }
code_block_43 = CodeBlock(SeeResult=createLeanConcrete.GeometryColor) { SeeResult; }
code_block_44 = CodeBlock(SeeResult=extractSideFacesOfElement.GeometryColor) { SeeResult; }
code_block_45 = CodeBlock(SeeResult=byGeometryColor_3) { SeeResult; }

# group: Select Target Family Element And Connected WorkMasters
code_block_46 = CodeBlock { 1; }
selectTargetFamilyInformAsDictionary_2 = Custom[SelectTargetFamilyInformAsDictionary](InputDic=organizeAllElementInformAsDictionary, InputIndex=code_block_46)

# group: Distributer
code_block_47 = CodeBlock(i=selectTargetFamilyInformAsDictionary_2) { i; }  # frozen
code_block_48 = CodeBlock(i=code_block_47) { i; }
code_block_49 = CodeBlock(i=code_block_48) { i; }
code_block_50 = CodeBlock(i=code_block_48) { i; }
code_block_51 = CodeBlock(i=code_block_47) { i; }
code_block_52 = CodeBlock(i=code_block_51) { i; }
code_block_53 = CodeBlock(i=code_block_47) { i; }
code_block_54 = CodeBlock(i=code_block_53) { i; }
code_block_55 = CodeBlock(i=code_block_47) { i; }
code_block_56 = CodeBlock(i=code_block_55) { i; }
code_block_57 = CodeBlock(i=code_block_48) { i; }
code_block_58 = CodeBlock(i=code_block_53) { i; }
code_block_59 = CodeBlock(i=code_block_53) { i; }
code_block_60 = CodeBlock(i=code_block_55) { i; }
code_block_61 = CodeBlock(i=code_block_55) { i; }
code_block_62 = CodeBlock(i=code_block_51) { i; }

code_block_63 = CodeBlock { "TargetElements"; }
valueAtKey_12 = DesignScript.Builtin.Dictionary.ValueAtKey(dictionary=code_block_49, key=code_block_63)
extractUpperFacesOfElement_2 = Custom[ExtractUpperFacesOfElement](Element=valueAtKey_12)

# group: <Func 2> - 수정필요
code_block_64 = CodeBlock { "TargetElements"; }
valueAtKey_13 = DesignScript.Builtin.Dictionary.ValueAtKey(dictionary=code_block_50, key=code_block_64)
# note: <Func>
extractSideFacesOfElement_3 = Custom[ExtractSideFacesOfElement](Element=valueAtKey_13)
area = Surface.Area(surface=extractSideFacesOfElement_3.Surface)
sum = Math.Sum(values=area)
code_block_65 = CodeBlock(i=sum) { Math.Round(List.Flatten(i)/1000000, 2); }
code_block_66 = CodeBlock { "M2"; }
count_4 = List.Count(list=code_block_65)
ofRepeatedItem_4 = List.OfRepeatedItem(item=code_block_66, amount=count_4)
code_block_67 = CodeBlock(FuncValues=code_block_65, FuncValuesUnit=ofRepeatedItem_4)  # same code as code_block_12

code_block_68 = CodeBlock { "TargetElements"; }
valueAtKey_14 = DesignScript.Builtin.Dictionary.ValueAtKey(dictionary=code_block_52, key=code_block_68)
code_block_69 = CodeBlock { 0; 100; }
createLeanConcrete_2 = Custom[CreateLeanConcrete](Element=valueAtKey_14, leanOffset=code_block_69.out0, leanThick=code_block_69.out1)
code_block_70 = CodeBlock { "TargetElements"; }
valueAtKey_15 = DesignScript.Builtin.Dictionary.ValueAtKey(dictionary=code_block_54, key=code_block_70)
code_block_71 = CodeBlock { 0; }
createExcavationSolid = Custom[CreateExcavationSolid](Element=valueAtKey_15, ExcavOffsetTop=code_block_71, ExcavOffsetBottom=code_block_71)  # CreateExcavationSolidForISOFDN
code_block_72 = CodeBlock { "TargetElements"; }
valueAtKey_16 = DesignScript.Builtin.Dictionary.ValueAtKey(dictionary=code_block_56, key=code_block_72)
createBaseCourseSurfaces_2 = Custom[CreateBaseCourseSurfaces](Element=valueAtKey_16)

# group: See Result
code_block_73 = CodeBlock(SeeResult=extractUpperFacesOfElement_2.GeometryColor) { SeeResult; }
code_block_74 = CodeBlock(SeeResult=extractSideFacesOfElement_3.GeometryColor) { SeeResult; }
code_block_75 = CodeBlock(SeeResult=createLeanConcrete_2.GeometryColor) { SeeResult; }
code_block_76 = CodeBlock(SeeResult=createExcavationSolid.GeometryColor) { SeeResult; }
code_block_77 = CodeBlock(SeeResult=createBaseCourseSurfaces_2.GeometryColor) { SeeResult; }

# group: Select Target Family Element And Connected WorkMasters
code_block_78 = CodeBlock { 2; }
selectTargetFamilyInformAsDictionary_3 = Custom[SelectTargetFamilyInformAsDictionary](InputDic=organizeAllElementInformAsDictionary, InputIndex=code_block_78)

# group: Distributer
code_block_79 = CodeBlock(i=selectTargetFamilyInformAsDictionary_3) { i; }  # frozen
code_block_80 = CodeBlock(i=code_block_79) { i; }
code_block_81 = CodeBlock(i=code_block_80) { i; }
code_block_82 = CodeBlock(i=code_block_80) { i; }
code_block_83 = CodeBlock(i=code_block_79) { i; }
code_block_84 = CodeBlock(i=code_block_83) { i; }
code_block_85 = CodeBlock(i=code_block_79) { i; }
code_block_86 = CodeBlock(i=code_block_85) { i; }
code_block_87 = CodeBlock(i=code_block_79) { i; }
code_block_88 = CodeBlock(i=code_block_87) { i; }
code_block_89 = CodeBlock(i=code_block_80) { i; }
code_block_90 = CodeBlock(i=code_block_85) { i; }
code_block_91 = CodeBlock(i=code_block_85) { i; }
code_block_92 = CodeBlock(i=code_block_87) { i; }
code_block_93 = CodeBlock(i=code_block_87) { i; }
code_block_94 = CodeBlock(i=code_block_83) { i; }

code_block_95 = CodeBlock { "TargetElements"; }
valueAtKey_17 = DesignScript.Builtin.Dictionary.ValueAtKey(dictionary=code_block_81, key=code_block_95)
extractUpperFacesOfElement_3 = Custom[ExtractUpperFacesOfElement](Element=valueAtKey_17)

# group: <Func 2> - 수정필요
code_block_96 = CodeBlock { "TargetElements"; }
valueAtKey_18 = DesignScript.Builtin.Dictionary.ValueAtKey(dictionary=code_block_82, key=code_block_96)
# note: <Func>
extractSideFacesOfElement_4 = Custom[ExtractSideFacesOfElement](Element=valueAtKey_18)
area_2 = Surface.Area(surface=extractSideFacesOfElement_4.Surface)
sum_2 = Math.Sum(values=area_2)
code_block_97 = CodeBlock(i=sum_2) { Math.Round(List.Flatten(i)/1000000, 2); }
code_block_98 = CodeBlock { "M2"; }
count_5 = List.Count(list=code_block_97)
ofRepeatedItem_5 = List.OfRepeatedItem(item=code_block_98, amount=count_5)
code_block_99 = CodeBlock(FuncValues=code_block_97, FuncValuesUnit=ofRepeatedItem_5)  # same code as code_block_12

code_block_100 = CodeBlock { "TargetElements"; }
valueAtKey_19 = DesignScript.Builtin.Dictionary.ValueAtKey(dictionary=code_block_84, key=code_block_100)
code_block_101 = CodeBlock { 0; 100; }
createLeanConcrete_3 = Custom[CreateLeanConcrete](Element=valueAtKey_19, leanOffset=code_block_101.out0, leanThick=code_block_101.out1)
code_block_102 = CodeBlock { "TargetElements"; }
valueAtKey_20 = DesignScript.Builtin.Dictionary.ValueAtKey(dictionary=code_block_86, key=code_block_102)
code_block_103 = CodeBlock { 0; }
createExcavationSolid_2 = Custom[CreateExcavationSolid](Element=valueAtKey_20, ExcavOffsetTop=code_block_103, ExcavOffsetBottom=code_block_103)
code_block_104 = CodeBlock { "TargetElements"; }
valueAtKey_21 = DesignScript.Builtin.Dictionary.ValueAtKey(dictionary=code_block_88, key=code_block_104)
createBaseCourseSurfaces_3 = Custom[CreateBaseCourseSurfaces](Element=valueAtKey_21)

# group: See Result
code_block_105 = CodeBlock(SeeResult=extractUpperFacesOfElement_3.GeometryColor) { SeeResult; }
code_block_106 = CodeBlock(SeeResult=extractSideFacesOfElement_4.GeometryColor) { SeeResult; }
code_block_107 = CodeBlock(SeeResult=createLeanConcrete_3.GeometryColor) { SeeResult; }
code_block_108 = CodeBlock(SeeResult=createExcavationSolid_2.GeometryColor) { SeeResult; }
code_block_109 = CodeBlock(SeeResult=createBaseCourseSurfaces_3.GeometryColor) { SeeResult; }

value_for_import_from_others_3 = CodeBlock(MainInput=selectTargetFamilyInformAsDictionary) { MainInput; RefInput; }  # unwired: RefInput

# group: <Func 0> Structural Concrete
code_block_110 = CodeBlock { "TargetElements"; }
valueAtKey_22 = DesignScript.Builtin.Dictionary.ValueAtKey(dictionary=value_for_import_from_others_3.MainInput, key=code_block_110)
code_block_111 = CodeBlock { "Volume"; }
# note: <Func>
getParameterValueByName_3 = Element.GetParameterValueByName(element=valueAtKey_22, parameterName=code_block_111)
code_block_112 = CodeBlock(i=getParameterValueByName_3) { Math.Round(List.Flatten(i)/1, 2); }
code_block_113 = CodeBlock { "M3"; }
count_6 = List.Count(list=code_block_112)
ofRepeatedItem_6 = List.OfRepeatedItem(item=code_block_113, amount=count_6)
code_block_114 = CodeBlock(FuncValues=code_block_112, FuncValuesUnit=ofRepeatedItem_6)  # same code as code_block_12

area_3 = Surface.Area(surface=createBaseCourseSurfaces.Surface)
code_block_115 = CodeBlock(i=area_3) { Math.Round(List.Flatten(i)/1000000, 2); }
code_block_116 = CodeBlock { "M2"; }
count_7 = List.Count(list=code_block_115)
ofRepeatedItem_7 = List.OfRepeatedItem(item=code_block_116, amount=count_7)
code_block_117 = CodeBlock(FuncValues=code_block_115, FuncValuesUnit=ofRepeatedItem_7)  # same code as code_block_12
area_4 = Surface.Area(surface=extractSideFacesOfElement.Surface)
sum_3 = Math.Sum(values=area_4)
code_block_118 = CodeBlock(i=sum_3) { Math.Round(List.Flatten(i)/1000000, 2); }
code_block_119 = CodeBlock { "M2"; }
count_8 = List.Count(list=code_block_118)
ofRepeatedItem_8 = List.OfRepeatedItem(item=code_block_119, amount=count_8)
code_block_120 = CodeBlock(FuncValues=code_block_118, FuncValuesUnit=ofRepeatedItem_8)  # same code as code_block_12

# group: <Func 5> Rebar
code_block_121 = CodeBlock { "TargetElements"; }
valueAtKey_23 = DesignScript.Builtin.Dictionary.ValueAtKey(key=code_block_121)  # unwired: dictionary
code_block_122 = CodeBlock { "Volume"; }
# note: <Func>
getParameterValueByName_4 = Element.GetParameterValueByName(element=valueAtKey_23, parameterName=code_block_122)
철근_비율 = DoubleInput(0)  # graph input
mul = getParameterValueByName_4 * 철근_비율
code_block_123 = CodeBlock(i=mul) { Math.Round(List.Flatten(i)/1, 2); }
code_block_124 = CodeBlock { "TON"; }
count_9 = List.Count(list=code_block_123)
ofRepeatedItem_9 = List.OfRepeatedItem(item=code_block_124, amount=count_9)
code_block_125 = CodeBlock(FuncValues=code_block_123, FuncValuesUnit=ofRepeatedItem_9)  # same code as code_block_12

# group: <Func 6> 린콘크리트
code_block_126 = CodeBlock { "TargetElements"; }
valueAtKey_24 = DesignScript.Builtin.Dictionary.ValueAtKey(key=code_block_126)  # unwired: dictionary
# note: <Func>
# note: 린 콘크리 업데이트 필요트
createLeanConcrete_4 = Custom[CreateLeanConcrete](Element=valueAtKey_24)
area_5 = Surface.Area(surface=createLeanConcrete_4.Surface)
code_block_127 = CodeBlock(i=area_5) { Math.Round(List.Flatten(i)/1000000, 2); }
code_block_128 = CodeBlock { "M2"; }
count_10 = List.Count(list=code_block_127)
ofRepeatedItem_10 = List.OfRepeatedItem(item=code_block_128, amount=count_10)
code_block_129 = CodeBlock(FuncValues=code_block_127, FuncValuesUnit=ofRepeatedItem_10)  # same code as code_block_12

area_6 = Surface.Area(surface=addItemToFront)
sum_4 = Math.Sum(values=area_6)
code_block_130 = CodeBlock(i=sum_4) { Math.Round(List.Flatten(i)/1000000, 2); }
code_block_131 = CodeBlock { "M2"; }
count_11 = List.Count(list=code_block_130)
ofRepeatedItem_11 = List.OfRepeatedItem(item=code_block_131, amount=count_11)
code_block_132 = CodeBlock(FuncValues=code_block_130, FuncValuesUnit=ofRepeatedItem_11)  # same code as code_block_12
join = List.Join(list0=code_block_114, list1=code_block_36.MainOutput, list2=code_block_117, list3=code_block_12, list4=code_block_120, list5=code_block_125, list6=code_block_129, list7=code_block_132)

# group: TargetWMunique + Data Sending
code_block_133 = CodeBlock(InputDic2=join) { _InputDic2; }
count_12 = List.Count(list=code_block_133)
code_block_134 = CodeBlock { _InputDic1; }  # unwired: InputDic1
code_block_135 = CodeBlock { "TargetWMunique"; }
valueAtKey_25 = DesignScript.Builtin.Dictionary.ValueAtKey(dictionary=code_block_134, key=code_block_135)
watch = Watch(valueAtKey_25)
count_13 = List.Count(list=watch)
eq = count_12 == count_13
organizeFuncValuesAndWorkMasterAsDiction = Custom[OrganizeFuncValuesAndWorkMasterAsDictionary](InputDic1=code_block_134, InputDic2=code_block_133)  # Organize FuncValues and WorkMaster As Dictionary
watch_2 = Watch()  # unwired: arg0
if_2 = If(test=eq, true=organizeFuncValuesAndWorkMasterAsDiction, false=watch_2)

# group: 데이터 취합 및 Row 방향 정렬
code_block_136 = CodeBlock(InputDic=if_2) { _InputDic; }
code_block_137 = CodeBlock { "TrTargetFamilyCode"; }
valueAtKey_26 = DesignScript.Builtin.Dictionary.ValueAtKey(dictionary=code_block_136, key=code_block_137)
watch_3 = Watch(valueAtKey_26)
flatten_14 = List.Flatten(list=watch_3)
code_block_138 = CodeBlock { "WMforTargetElements"; }
valueAtKey_27 = DesignScript.Builtin.Dictionary.ValueAtKey(dictionary=code_block_136, key=code_block_138)
watch_4 = Watch(valueAtKey_27)
flatten_15 = List.Flatten(list=watch_4)
code_block_139 = CodeBlock { "TargetFuncValues"; }
valueAtKey_28 = DesignScript.Builtin.Dictionary.ValueAtKey(dictionary=code_block_136, key=code_block_139)
watch_5 = Watch(valueAtKey_28)
flatten_16 = List.Flatten(list=watch_5)
code_block_140 = CodeBlock { "TargetFuncValuesUnit"; }
valueAtKey_29 = DesignScript.Builtin.Dictionary.ValueAtKey(dictionary=code_block_136, key=code_block_140)
watch_6 = Watch(valueAtKey_29)
flatten_17 = List.Flatten(list=watch_6)
list_create_3 = List.Create(item0=flatten_14, item1=flatten_15, item2=flatten_16, item3=flatten_17)
transpose_3 = List.Transpose(lists=list_create_3)

area_7 = Surface.Area(surface=extractUpperFacesOfElement_2.Surface)
sum_5 = Math.Sum(values=area_7)
code_block_141 = CodeBlock(i=sum_5) { Math.Round(List.Flatten(i)/1000000, 2); }
code_block_142 = CodeBlock { "M3"; }
count_14 = List.Count(list=code_block_141)
ofRepeatedItem_12 = List.OfRepeatedItem(item=code_block_142, amount=count_14)
code_block_143 = CodeBlock(FuncValues=code_block_141, FuncValuesUnit=ofRepeatedItem_12)  # same code as code_block_12
code_block_144 = CodeBlock { "TargetElements"; }
valueAtKey_30 = DesignScript.Builtin.Dictionary.ValueAtKey(dictionary=code_block_57, key=code_block_144)
code_block_145 = CodeBlock { "Volume"; }
getParameterValueByName_5 = Element.GetParameterValueByName(element=valueAtKey_30, parameterName=code_block_145)
code_block_146 = CodeBlock(i=getParameterValueByName_5) { Math.Round(List.Flatten(i)/1000000, 2); }
code_block_147 = CodeBlock { "M3"; }
count_15 = List.Count(list=code_block_146)
ofRepeatedItem_13 = List.OfRepeatedItem(item=code_block_147, amount=count_15)
code_block_148 = CodeBlock(FuncValues=code_block_146, FuncValuesUnit=ofRepeatedItem_13)  # same code as code_block_12
code_block_149 = CodeBlock { "TargetElements"; }
valueAtKey_31 = DesignScript.Builtin.Dictionary.ValueAtKey(dictionary=code_block_58, key=code_block_149)
createLeanConcrete_5 = Custom[CreateLeanConcrete](Element=valueAtKey_31)
area_8 = Surface.Area(surface=createLeanConcrete_5.Surface)
code_block_150 = CodeBlock(i=area_8) { Math.Round(List.Flatten(i)/1000000, 2); }
code_block_151 = CodeBlock { "M2"; }
count_16 = List.Count(list=code_block_150)
ofRepeatedItem_14 = List.OfRepeatedItem(item=code_block_151, amount=count_16)
code_block_152 = CodeBlock(FuncValues=code_block_150, FuncValuesUnit=ofRepeatedItem_14)  # same code as code_block_12
map = List.Map()  # unwired: list, function
isNull_3 = Object.IsNull(object=createExcavationSolid.Solid)
code_block_153 = CodeBlock { 1; }
mul_2 = _ * code_block_153  # unwired: x
volume_4 = Solid.Volume()  # unwired: solid
if_3 = If(test=isNull_3, true=mul_2, false=volume_4)
code_block_154 = CodeBlock { 0; }
isNull_4 = Object.IsNull()  # unwired: object
replaceByCondition_3 = Replace(item=createExcavationSolid.Solid, replaceWith=code_block_154, condition=isNull_4)
laceShortest = List.LaceShortest(combineFunction=map, list0=if_3, list1=replaceByCondition_3)
code_block_155 = CodeBlock(i=laceShortest) { Math.Round(List.Flatten(i)/1000000000, 2); }
code_block_156 = CodeBlock { "M3"; }
count_17 = List.Count(list=code_block_155)
ofRepeatedItem_15 = List.OfRepeatedItem(item=code_block_156, amount=count_17)
code_block_157 = CodeBlock(FuncValues=code_block_155, FuncValuesUnit=ofRepeatedItem_15)  # same code as code_block_12
code_block_158 = CodeBlock { 0; }
code_block_159 = CodeBlock { "TargetElements"; }
valueAtKey_32 = DesignScript.Builtin.Dictionary.ValueAtKey(dictionary=code_block_59, key=code_block_159)
count_18 = List.Count(list=valueAtKey_32@L1)
ofRepeatedItem_16 = List.OfRepeatedItem(item=code_block_158, amount=count_18)
code_block_160 = CodeBlock(i=ofRepeatedItem_16) { Math.Round(List.Flatten(i)/1000000000, 2); }
code_block_161 = CodeBlock { "M3"; }
count_19 = List.Count(list=code_block_160)
ofRepeatedItem_17 = List.OfRepeatedItem(item=code_block_161, amount=count_19)
code_block_162 = CodeBlock(FuncValues=code_block_160, FuncValuesUnit=ofRepeatedItem_17)  # same code as code_block_12
code_block_163 = CodeBlock { 0; }
code_block_164 = CodeBlock { "TargetElements"; }
valueAtKey_33 = DesignScript.Builtin.Dictionary.ValueAtKey(dictionary=code_block_60, key=code_block_164)
count_20 = List.Count(list=valueAtKey_33@L1)
ofRepeatedItem_18 = List.OfRepeatedItem(item=code_block_163, amount=count_20)
code_block_165 = CodeBlock(i=ofRepeatedItem_18) { Math.Round(List.Flatten(i)/1000000000, 2); }
code_block_166 = CodeBlock { "M3"; }
count_21 = List.Count(list=code_block_165)
ofRepeatedItem_19 = List.OfRepeatedItem(item=code_block_166, amount=count_21)
code_block_167 = CodeBlock(FuncValues=code_block_165, FuncValuesUnit=ofRepeatedItem_19)  # same code as code_block_12
area_9 = Surface.Area(surface=createBaseCourseSurfaces_2.Surface)
code_block_168 = CodeBlock(i=area_9) { Math.Round(List.Flatten(i)/1000000, 2); }
code_block_169 = CodeBlock { "M2"; }
count_22 = List.Count(list=code_block_168)
ofRepeatedItem_20 = List.OfRepeatedItem(item=code_block_169, amount=count_22)
code_block_170 = CodeBlock(FuncValues=code_block_168, FuncValuesUnit=ofRepeatedItem_20)  # same code as code_block_12
code_block_171 = CodeBlock { 0; }
code_block_172 = CodeBlock { "TargetElements"; }
valueAtKey_34 = DesignScript.Builtin.Dictionary.ValueAtKey(dictionary=code_block_61, key=code_block_172)
count_23 = List.Count(list=valueAtKey_34@L1)
ofRepeatedItem_21 = List.OfRepeatedItem(item=code_block_171, amount=count_23)
code_block_173 = CodeBlock(i=ofRepeatedItem_21) { Math.Round(List.Flatten(i)/1000000000, 2); }
code_block_174 = CodeBlock { "M3"; }
count_24 = List.Count(list=code_block_173)
ofRepeatedItem_22 = List.OfRepeatedItem(item=code_block_174, amount=count_24)
code_block_175 = CodeBlock(FuncValues=code_block_173, FuncValuesUnit=ofRepeatedItem_22)  # same code as code_block_12
volume_5 = Solid.Volume(solid=createLeanConcrete_2.Solid)
code_block_176 = CodeBlock(i=volume_5) { Math.Round(List.Flatten(i)/1000000000, 2); }
code_block_177 = CodeBlock { "M3"; }
count_25 = List.Count(list=code_block_176)
ofRepeatedItem_23 = List.OfRepeatedItem(item=code_block_177, amount=count_25)
code_block_178 = CodeBlock(FuncValues=code_block_176, FuncValuesUnit=ofRepeatedItem_23)  # same code as code_block_12
code_block_179 = CodeBlock { "TargetElements"; }
valueAtKey_35 = DesignScript.Builtin.Dictionary.ValueAtKey(dictionary=code_block_62, key=code_block_179)
code_block_180 = CodeBlock { "Volume"; }
getParameterValueByName_6 = Element.GetParameterValueByName(element=valueAtKey_35, parameterName=code_block_180)
code_block_181 = CodeBlock { 0.1; }
mul_3 = getParameterValueByName_6 * code_block_181
code_block_182 = CodeBlock(i=mul_3) { Math.Round(List.Flatten(i)/1, 2); }
code_block_183 = CodeBlock { "TON"; }
count_26 = List.Count(list=code_block_182)
ofRepeatedItem_24 = List.OfRepeatedItem(item=code_block_183, amount=count_26)
code_block_184 = CodeBlock(FuncValues=code_block_182, FuncValuesUnit=ofRepeatedItem_24)  # same code as code_block_12
join_2 = List.Join(list0=code_block_143, list1=code_block_148, list2=code_block_67, list3=code_block_152, list4=code_block_157, list5=code_block_162, list6=code_block_167, list7=code_block_170, list8=code_block_175, list9=code_block_178, list10=code_block_184)

# group: TargetWMunique + Data Sending
code_block_185 = CodeBlock(InputDic2=join_2) { _InputDic2; }
count_27 = List.Count(list=code_block_185)
code_block_186 = CodeBlock(InputDic1=code_block_47) { _InputDic1; }
code_block_187 = CodeBlock { "TargetWMunique"; }
valueAtKey_36 = DesignScript.Builtin.Dictionary.ValueAtKey(dictionary=code_block_186, key=code_block_187)
watch_7 = Watch(valueAtKey_36)
count_28 = List.Count(list=watch_7)
eq_2 = count_27 == count_28
organizeFuncValuesAndWorkMasterAsDiction_2 = Custom[OrganizeFuncValuesAndWorkMasterAsDictionary](InputDic1=code_block_186, InputDic2=code_block_185)
watch_8 = Watch()  # unwired: arg0
if_4 = If(test=eq_2, true=organizeFuncValuesAndWorkMasterAsDiction_2, false=watch_8)

# group: 데이터 취합 및 Row 방향 정렬
code_block_188 = CodeBlock(InputDic=if_4) { _InputDic; }
code_block_189 = CodeBlock { "TrTargetFamilyCode"; }
valueAtKey_37 = DesignScript.Builtin.Dictionary.ValueAtKey(dictionary=code_block_188, key=code_block_189)
watch_9 = Watch(valueAtKey_37)
flatten_18 = List.Flatten(list=watch_9)
code_block_190 = CodeBlock { "WMforTargetElements"; }
valueAtKey_38 = DesignScript.Builtin.Dictionary.ValueAtKey(dictionary=code_block_188, key=code_block_190)
watch_10 = Watch(valueAtKey_38)
flatten_19 = List.Flatten(list=watch_10)
code_block_191 = CodeBlock { "TargetFuncValues"; }
valueAtKey_39 = DesignScript.Builtin.Dictionary.ValueAtKey(dictionary=code_block_188, key=code_block_191)
watch_11 = Watch(valueAtKey_39)
flatten_20 = List.Flatten(list=watch_11)
code_block_192 = CodeBlock { "TargetFuncValuesUnit"; }
valueAtKey_40 = DesignScript.Builtin.Dictionary.ValueAtKey(dictionary=code_block_188, key=code_block_192)
watch_12 = Watch(valueAtKey_40)
flatten_21 = List.Flatten(list=watch_12)
list_create_4 = List.Create(item0=flatten_18, item1=flatten_19, item2=flatten_20, item3=flatten_21)
transpose_4 = List.Transpose(lists=list_create_4)

area_10 = Surface.Area(surface=extractUpperFacesOfElement_3.Surface)
sum_6 = Math.Sum(values=area_10)
code_block_193 = CodeBlock(i=sum_6) { Math.Round(List.Flatten(i)/1000000, 2); }
code_block_194 = CodeBlock { "M3"; }
count_29 = List.Count(list=code_block_193)
ofRepeatedItem_25 = List.OfRepeatedItem(item=code_block_194, amount=count_29)
code_block_195 = CodeBlock(FuncValues=code_block_193, FuncValuesUnit=ofRepeatedItem_25)  # same code as code_block_12
code_block_196 = CodeBlock { "TargetElements"; }
valueAtKey_41 = DesignScript.Builtin.Dictionary.ValueAtKey(dictionary=code_block_89, key=code_block_196)
code_block_197 = CodeBlock { "Volume"; }
getParameterValueByName_7 = Element.GetParameterValueByName(element=valueAtKey_41, parameterName=code_block_197)
code_block_198 = CodeBlock(i=getParameterValueByName_7) { Math.Round(List.Flatten(i)/1000000, 2); }
code_block_199 = CodeBlock { "M3"; }
count_30 = List.Count(list=code_block_198)
ofRepeatedItem_26 = List.OfRepeatedItem(item=code_block_199, amount=count_30)
code_block_200 = CodeBlock(FuncValues=code_block_198, FuncValuesUnit=ofRepeatedItem_26)  # same code as code_block_12
code_block_201 = CodeBlock { "TargetElements"; }
valueAtKey_42 = DesignScript.Builtin.Dictionary.ValueAtKey(dictionary=code_block_90, key=code_block_201)
createLeanConcrete_6 = Custom[CreateLeanConcrete](Element=valueAtKey_42)
area_11 = Surface.Area(surface=createLeanConcrete_6.Surface)
code_block_202 = CodeBlock(i=area_11) { Math.Round(List.Flatten(i)/1000000, 2); }
code_block_203 = CodeBlock { "M2"; }
count_31 = List.Count(list=code_block_202)
ofRepeatedItem_27 = List.OfRepeatedItem(item=code_block_203, amount=count_31)
code_block_204 = CodeBlock(FuncValues=code_block_202, FuncValuesUnit=ofRepeatedItem_27)  # same code as code_block_12
map_2 = List.Map()  # unwired: list, function
isNull_5 = Object.IsNull(object=createExcavationSolid_2.Solid)
code_block_205 = CodeBlock { 1; }
mul_4 = _ * code_block_205  # unwired: x
volume_6 = Solid.Volume()  # unwired: solid
if_5 = If(test=isNull_5, true=mul_4, false=volume_6)
code_block_206 = CodeBlock { 0; }
isNull_6 = Object.IsNull()  # unwired: object
replaceByCondition_4 = Replace(item=createExcavationSolid_2.Solid, replaceWith=code_block_206, condition=isNull_6)
laceShortest_2 = List.LaceShortest(combineFunction=map_2, list0=if_5, list1=replaceByCondition_4)
code_block_207 = CodeBlock(i=laceShortest_2) { Math.Round(List.Flatten(i)/1000000000, 2); }
code_block_208 = CodeBlock { "M3"; }
count_32 = List.Count(list=code_block_207)
ofRepeatedItem_28 = List.OfRepeatedItem(item=code_block_208, amount=count_32)
code_block_209 = CodeBlock(FuncValues=code_block_207, FuncValuesUnit=ofRepeatedItem_28)  # same code as code_block_12
code_block_210 = CodeBlock { 0; }
code_block_211 = CodeBlock { "TargetElements"; }
valueAtKey_43 = DesignScript.Builtin.Dictionary.ValueAtKey(dictionary=code_block_91, key=code_block_211)
count_33 = List.Count(list=valueAtKey_43@L1)
ofRepeatedItem_29 = List.OfRepeatedItem(item=code_block_210, amount=count_33)
code_block_212 = CodeBlock(i=ofRepeatedItem_29) { Math.Round(List.Flatten(i)/1000000000, 2); }
code_block_213 = CodeBlock { "M3"; }
count_34 = List.Count(list=code_block_212)
ofRepeatedItem_30 = List.OfRepeatedItem(item=code_block_213, amount=count_34)
code_block_214 = CodeBlock(FuncValues=code_block_212, FuncValuesUnit=ofRepeatedItem_30)  # same code as code_block_12
code_block_215 = CodeBlock { 0; }
code_block_216 = CodeBlock { "TargetElements"; }
valueAtKey_44 = DesignScript.Builtin.Dictionary.ValueAtKey(dictionary=code_block_92, key=code_block_216)
count_35 = List.Count(list=valueAtKey_44@L1)
ofRepeatedItem_31 = List.OfRepeatedItem(item=code_block_215, amount=count_35)
code_block_217 = CodeBlock(i=ofRepeatedItem_31) { Math.Round(List.Flatten(i)/1000000000, 2); }
code_block_218 = CodeBlock { "M3"; }
count_36 = List.Count(list=code_block_217)
ofRepeatedItem_32 = List.OfRepeatedItem(item=code_block_218, amount=count_36)
code_block_219 = CodeBlock(FuncValues=code_block_217, FuncValuesUnit=ofRepeatedItem_32)  # same code as code_block_12
area_12 = Surface.Area(surface=createBaseCourseSurfaces_3.Surface)
code_block_220 = CodeBlock(i=area_12) { Math.Round(List.Flatten(i)/1000000, 2); }
code_block_221 = CodeBlock { "M2"; }
count_37 = List.Count(list=code_block_220)
ofRepeatedItem_33 = List.OfRepeatedItem(item=code_block_221, amount=count_37)
code_block_222 = CodeBlock(FuncValues=code_block_220, FuncValuesUnit=ofRepeatedItem_33)  # same code as code_block_12
code_block_223 = CodeBlock { 0; }
code_block_224 = CodeBlock { "TargetElements"; }
valueAtKey_45 = DesignScript.Builtin.Dictionary.ValueAtKey(dictionary=code_block_93, key=code_block_224)
count_38 = List.Count(list=valueAtKey_45@L1)
ofRepeatedItem_34 = List.OfRepeatedItem(item=code_block_223, amount=count_38)
code_block_225 = CodeBlock(i=ofRepeatedItem_34) { Math.Round(List.Flatten(i)/1000000000, 2); }
code_block_226 = CodeBlock { "M3"; }
count_39 = List.Count(list=code_block_225)
ofRepeatedItem_35 = List.OfRepeatedItem(item=code_block_226, amount=count_39)
code_block_227 = CodeBlock(FuncValues=code_block_225, FuncValuesUnit=ofRepeatedItem_35)  # same code as code_block_12
volume_7 = Solid.Volume(solid=createLeanConcrete_3.Solid)
code_block_228 = CodeBlock(i=volume_7) { Math.Round(List.Flatten(i)/1000000000, 2); }
code_block_229 = CodeBlock { "M3"; }
count_40 = List.Count(list=code_block_228)
ofRepeatedItem_36 = List.OfRepeatedItem(item=code_block_229, amount=count_40)
code_block_230 = CodeBlock(FuncValues=code_block_228, FuncValuesUnit=ofRepeatedItem_36)  # same code as code_block_12
code_block_231 = CodeBlock { "TargetElements"; }
valueAtKey_46 = DesignScript.Builtin.Dictionary.ValueAtKey(dictionary=code_block_94, key=code_block_231)
code_block_232 = CodeBlock { "Volume"; }
getParameterValueByName_8 = Element.GetParameterValueByName(element=valueAtKey_46, parameterName=code_block_232)
code_block_233 = CodeBlock { 0.1; }
mul_5 = getParameterValueByName_8 * code_block_233
code_block_234 = CodeBlock(i=mul_5) { Math.Round(List.Flatten(i)/1, 2); }
code_block_235 = CodeBlock { "TON"; }
count_41 = List.Count(list=code_block_234)
ofRepeatedItem_37 = List.OfRepeatedItem(item=code_block_235, amount=count_41)
code_block_236 = CodeBlock(FuncValues=code_block_234, FuncValuesUnit=ofRepeatedItem_37)  # same code as code_block_12
join_3 = List.Join(list0=code_block_195, list1=code_block_200, list2=code_block_99, list3=code_block_204, list4=code_block_209, list5=code_block_214, list6=code_block_219, list7=code_block_222, list8=code_block_227, list9=code_block_230, list10=code_block_236)

# group: TargetWMunique + Data Sending
code_block_237 = CodeBlock(InputDic2=join_3) { _InputDic2; }
count_42 = List.Count(list=code_block_237)
code_block_238 = CodeBlock(InputDic1=code_block_79) { _InputDic1; }
code_block_239 = CodeBlock { "TargetWMunique"; }
valueAtKey_47 = DesignScript.Builtin.Dictionary.ValueAtKey(dictionary=code_block_238, key=code_block_239)
watch_13 = Watch(valueAtKey_47)
count_43 = List.Count(list=watch_13)
eq_3 = count_42 == count_43
organizeFuncValuesAndWorkMasterAsDiction_3 = Custom[OrganizeFuncValuesAndWorkMasterAsDictionary](InputDic1=code_block_238, InputDic2=code_block_237)
watch_14 = Watch()  # unwired: arg0
if_6 = If(test=eq_3, true=organizeFuncValuesAndWorkMasterAsDiction_3, false=watch_14)

# group: 데이터 취합 및 Row 방향 정렬
code_block_240 = CodeBlock(InputDic=if_6) { _InputDic; }
code_block_241 = CodeBlock { "TrTargetFamilyCode"; }
valueAtKey_48 = DesignScript.Builtin.Dictionary.ValueAtKey(dictionary=code_block_240, key=code_block_241)
watch_15 = Watch(valueAtKey_48)
flatten_22 = List.Flatten(list=watch_15)
code_block_242 = CodeBlock { "WMforTargetElements"; }
valueAtKey_49 = DesignScript.Builtin.Dictionary.ValueAtKey(dictionary=code_block_240, key=code_block_242)
watch_16 = Watch(valueAtKey_49)
flatten_23 = List.Flatten(list=watch_16)
code_block_243 = CodeBlock { "TargetFuncValues"; }
valueAtKey_50 = DesignScript.Builtin.Dictionary.ValueAtKey(dictionary=code_block_240, key=code_block_243)
watch_17 = Watch(valueAtKey_50)
flatten_24 = List.Flatten(list=watch_17)
code_block_244 = CodeBlock { "TargetFuncValuesUnit"; }
valueAtKey_51 = DesignScript.Builtin.Dictionary.ValueAtKey(dictionary=code_block_240, key=code_block_244)
watch_18 = Watch(valueAtKey_51)
flatten_25 = List.Flatten(list=watch_18)
list_create_5 = List.Create(item0=flatten_22, item1=flatten_23, item2=flatten_24, item3=flatten_25)
transpose_5 = List.Transpose(lists=list_create_5)

# group: 패밀리 별 취합 + Export Excel(By OpenpyXl)
# note: Excel Export Button
boolean = BoolSelector(false)
join_4 = List.Join(list0=transpose_3, list1=transpose_4, list2=transpose_5)
watch_19 = Watch()  # unwired: arg0
if_7 = If(test=boolean, true=join_4, false=watch_19)
python_script_export_excel_by = Python(IN[0]=if_7)  # "Python Script@Export Excel(By OpenpyXl)"; CPython3
# ---------- python_script_export_excel_by.python (151 lines) ----------
# Load the Python Standard and DesignScript Libraries
import sys
import os
#sys.path.append(r'C:\Users\HEC\AppData\Local\Programs\Python\Python39\Lib\site-packages')
#sys.path.append(r'C:\Users\pjmk0\AppData\Local\Programs\Python\Python39\Lib\site-packages')
sys.path.append(os.getenv('LOCALAPPDATA').replace('\\','\\\\') + r'\Programs\Python\Python39\Lib\site-packages')
import clr
clr.AddReference('ProtoGeometry')
from Autodesk.DesignScript.Geometry import *
from collections import Iterable

def iterable(obj):
    return isinstance(obj, Iterable)


# The inputs to this node will be stored as a list in the IN variables.
dataEnteringNode = IN
ListIn = IN[0]

# Place your code below this line
import datetime
from datetime import date, timedelta
Today = date.today()
import openpyxl
from openpyxl.styles import Border, Side, PatternFill, Font, GradientFill, Alignment, Color, numbers

sample_items = ListIn


def write_to_file(filepath):
    wb = openpyxl.Workbook()
    for sheet in wb.sheetnames:
        wb.remove(wb[sheet])

    thin = Side(border_style="thin", color="000000")
    double = Side(border_style="double", color="000000")

    ws = wb.create_sheet(title='Wall_Calc_instance', index=0)

    ws.merge_cells('A1:L1')
    ws['A1'] = 'HEC Wall Category Calculation Sheet'
    cell = ws['A1']
    cell.font = openpyxl.styles.Font(color='000000', size=20)
    cell.fill = openpyxl.styles.fills.PatternFill(patternType='solid',
                                                  fgColor=openpyxl.styles.colors.Color(rgb='fff3b0'))

    ws['A2'] = 'Item Number'
    ws['A2'].font = openpyxl.styles.Font(b=True, color='000000', size=12)
    #ws['B2'] = 'Member Name'
    #ws['B2'].font = openpyxl.styles.Font(b=True, color='000000', size=12)
    #ws['C2'] = 'Category'
    #ws['C2'].font = openpyxl.styles.Font(b=True, color='000000', size=12)
    ws['B2'] = 'Family Type'
    ws['B2'].font = openpyxl.styles.Font(b=True, color='000000', size=12)
    ws['C2'] = 'WorkMaster Code'
    ws['C2'].font = openpyxl.styles.Font(b=True, color='000000', size=12)
    #ws['F2'] = 'WorkMaster Description'
    #ws['F2'].font = openpyxl.styles.Font(b=True, color='000000', size=12)
    #ws['G2'] = 'Unit'
    #ws['G2'].font = openpyxl.styles.Font(b=True, color='000000', size=12)
    #ws['H2'] = '계수'
    #ws['H2'].font = openpyxl.styles.Font(b=True, color='000000', size=12)
    #ws['I2'] = '계산 참조값'
    #ws['I2'].font = openpyxl.styles.Font(b=True, color='000000', size=12)
    ws['D2'] = 'Quantities'
    ws['D2'].font = openpyxl.styles.Font(b=True, color='000000', size=12)
    ws['E2'] = 'Unit'
    ws['E2'].font = openpyxl.styles.Font(b=True, color='000000', size=12)
    ws['F2'] = 'Unit Price'
    ws['F2'].font = openpyxl.styles.Font(b=True, color='000000', size=12)
    ws['G2'] = 'Total Price'
    ws['G2'].font = openpyxl.styles.Font(b=True, color='000000', size=12)


## 칼럼별 너비 조정 구간
#    for col in range(ws.max_column):
#        ws.column_dimensions[chr(ord('A') + col)].width = 15
    ws.column_dimensions['A'].width = 15
    ws.column_dimensions['B'].width = 45
    ws.column_dimensions['C'].width = 60
    ws.column_dimensions['D'].width = 20
    ws.column_dimensions['E'].width = 20
    ws.column_dimensions['F'].width = 20
    ws.column_dimensions['G'].width = 20
    #ws.column_dimensions['G'].width = 9
    #ws.column_dimensions['H'].width = 9
    #ws.column_dimensions['H'].hidden = True
    #ws.column_dimensions['I'].width = 12
    #ws.column_dimensions['I'].hidden = True
    #ws.column_dimensions['J'].width = 12
    #ws.column_dimensions['K'].width = 12
    #ws.column_dimensions['L'].width = 12

###
    start_row = 3
    for (row, item) in enumerate(sample_items, start_row):
        cell = ws.cell(row=row, column=1, value=row - 2)
        cell.alignment = openpyxl.styles.Alignment(horizontal='center', vertical='center')

#        cell = ws.cell(row=row, column=2, value=item[0])
#        cell.number_format = openpyxl.styles.numbers.FORMAT_DATE_YYYYMMDD2  # 'yyyy-mm-dd'
        ws.cell(row=row, column=2, value=item[0]) ## Family Type 칼럼

        ws.cell(row=row, column=3, value=item[1]) ## WorkMaster Code 칼럼
        
        ws.cell(row=row, column=4, value=item[2]) ## Quantities 칼럼
        
        ws.cell(row=row, column=5, value=item[3]) ## Unit 칼럼
        
        #cell = ws.cell(row=row, column=8, value=item[6]) ## 계수 칼럼
        #cell.number_format = openpyxl.styles.numbers.builtin_format_code(3)  # '#,##0'
        
        #cell = ws.cell(row=row, column=9, value=item[7]) ## 계산 참조값 칼럼
        #cell.number_format = openpyxl.styles.numbers.builtin_format_code(3)  # '#,##0'
        
        #cell = ws.cell(row=row, column=10, value=item[8]) ## Quantities 칼럼
        #cell.number_format = openpyxl.styles.numbers.builtin_format_code(3)  # '#,##0'
        #cell.font = openpyxl.styles.Font(b=True, color='000000', size=11)

        cell = ws.cell(row=row, column=7, value='= D{current_row}*F{current_row}'.format(current_row=cell.row))
        cell.number_format = '#,##0'

#        cell = ws.cell(row=row, column=6, value='= D{current_row} * E{current_row}'.format(current_row=cell.row))
#        cell.number_format = openpyxl.styles.numbers.builtin_format_code(3)

    total_row = ws.max_row + 1
    if total_row > start_row:
        cell1 = ws.cell(row=total_row, column=6, value='Total')
        cell1.font = openpyxl.styles.Font(b=True, color='000000', size=15)
        
        cell2 = ws.cell(row=total_row, column=7, value='= SUM(G{}:G{})'.format(start_row, total_row - 1))
        cell2.number_format = openpyxl.styles.numbers.builtin_format_code(3)
        cell2.border = Border(top=double, left=double, right=double, bottom=double)
        cell2.font = openpyxl.styles.Font(b=True, color='ff03ce', size=15)
    

    wb.save(filepath)
    wb.close()


##if __name__ == '__main__':
#write_to_file('C:\\Users\\pjmk0\\AppData\\Roaming\\test.xlsx')

save_name = "HecStrFDNCalcSheet_" + Today.strftime("%Y-%m-%d")+".xlsx"
path = os.getenv('APPDATA').replace('\\','\\\\')
filePath = path + '\\' + save_name

write_to_file(filePath)

# Assign your output to the OUT variable.
OUT = os.getenv('APPDATA')
# ----------------------------------------

# group: 되메우기
value_for_import_from_others_4 = CodeBlock(터파기형상=code_block_36.RefOutput_터파기형상) { 터파기형상; }
flatten_26 = List.Flatten(list=value_for_import_from_others_4)
volume_8 = Solid.Volume(solid=flatten_26)
flatten_27 = List.Flatten(list=createLeanConcrete.Solid)
code_block_245 = CodeBlock { "TargetElements"; }
valueAtKey_52 = DesignScript.Builtin.Dictionary.ValueAtKey(key=code_block_245)  # unwired: dictionary
geometry = Element.Geometry(element=valueAtKey_52)
flatten_28 = List.Flatten(list=geometry)
categories_2 = Categories("OST_StructuralColumns")
all_elements_of_category_2 = ElementsOfCategory(Category=categories_2)
geometry_2 = Element.Geometry(element=all_elements_of_category_2)
flatten_29 = List.Flatten(list=geometry_2)
doesIntersect_2 = Geometry.DoesIntersect(geometry=flatten_26, other=flatten_29, lacing=CrossProduct)
filterByBoolMask = List.FilterByBoolMask(list=flatten_29, mask=doesIntersect_2@L2)
flatten_30 = List.Flatten(list=filterByBoolMask.in)
list_create_6 = List.Create(item0=flatten_27, item1=flatten_28, item2=flatten_30)
transpose_6 = List.Transpose(lists=list_create_6)
byUnion = Solid.ByUnion(solids=transpose_6)
volume_9 = Solid.Volume(solid=byUnion)
code_block_246 = CodeBlock(터파기볼륨=volume_8, 콘크리트들볼륨=volume_9) { 터파기볼륨 - 콘크리트들볼륨; }
watch_20 = Watch(code_block_246)
code_block_247 = CodeBlock(i=watch_20) { Math.Round(List.Flatten(i)/1000000000, 2); }
code_block_248 = CodeBlock { "M3"; }
# note: 터파기 물량ㅈ에서 콘크리트, 린 기둥 물량 빼기
count_44 = List.Count(list=watch_20)
ofRepeatedItem_38 = List.OfRepeatedItem(item=code_block_248, amount=count_44)
code_block_249 = CodeBlock(FuncValues=code_block_247, FuncValuesUnit=ofRepeatedItem_38)  # same code as code_block_12

# group: Disposal 잔토처리 1.2 비율
watch_21 = Watch(volume_9)
토량_환산_계수 = DoubleInput(1)  # graph input
code_block_250 = CodeBlock(i=watch_21, 토량환산계수=토량_환산_계수) { Math.Round(List.Flatten(i)/1000000000, 2)*토량환산계수; }
code_block_251 = CodeBlock { "M3"; }
count_45 = List.Count(list=watch_21)
ofRepeatedItem_39 = List.OfRepeatedItem(item=code_block_251, amount=count_45)
# note: 잔토처리
code_block_252 = CodeBlock(FuncValues=code_block_250, FuncValuesUnit=ofRepeatedItem_39)  # same code as code_block_12

code_block_253 = CodeBlock(MainOutput=code_block_114) { MainOutput; }
