# Dynamo graph C_door ceilling window etc_DataStructureTest(0729).dyn (Dynamo 2.10.1.3976)

# group: Example
code_block = CodeBlock { ["a","b","c"]; [1,2,3]; }
byKeysValues = DesignScript.Builtin.Dictionary.ByKeysValues(keys=code_block.out0, values=code_block.out1)
code_block_2 = CodeBlock { ["d","e","f"]; [4,5,6]; }
byKeysValues_2 = DesignScript.Builtin.Dictionary.ByKeysValues(keys=code_block_2.out0, values=code_block_2.out1)
code_block_3 = CodeBlock(a1=byKeysValues, b1=byKeysValues_2)
# ---------- code_block_3.designscript (4 lines) ----------
{
"a1": a1
,"b1": b1
};
# ----------------------------------------
code_block_4 = CodeBlock { "a1"; }
valueAtKey = DesignScript.Builtin.Dictionary.ValueAtKey(dictionary=code_block_3, key=code_block_4)
code_block_5 = CodeBlock { "a"; }
valueAtKey_2 = DesignScript.Builtin.Dictionary.ValueAtKey(dictionary=valueAtKey, key=code_block_5)

# group: Select Target Family Element And Connected WorkMasters
code_block_6 = CodeBlock { 0; }
selectTargetFamilyInformAsDictionary = Custom[SelectTargetFamilyInformAsDictionary](InputIndex=code_block_6)  # Select Target Family Element And Connected WorkMasters; unwired: InputDic

# group: Distributer
code_block_7 = CodeBlock(i=selectTargetFamilyInformAsDictionary) { i; }
code_block_8 = CodeBlock(i=code_block_7) { i; }
code_block_9 = CodeBlock(i=code_block_8) { i; }
code_block_10 = CodeBlock(i=code_block_8) { i; }
code_block_11 = CodeBlock(i=code_block_8) { i; }
code_block_12 = CodeBlock(i=code_block_7) { i; }
code_block_13 = CodeBlock(i=code_block_12) { i; }
code_block_14 = CodeBlock(i=code_block_12) { i; }
code_block_15 = CodeBlock(i=code_block_8) { i; }
code_block_16 = CodeBlock(i=code_block_12) { i; }
code_block_17 = CodeBlock(i=code_block_12) { i; }

code_block_18 = CodeBlock { "TargetElements"; }
valueAtKey_3 = DesignScript.Builtin.Dictionary.ValueAtKey(dictionary=code_block_9, key=code_block_18)
# note: <Func>
createBaseCourseSurfaces = Custom[CreateBaseCourseSurfaces](Element=valueAtKey_3)  # CreateBaseCourseSurfaces
code_block_19 = CodeBlock { "TargetElements"; }
valueAtKey_4 = DesignScript.Builtin.Dictionary.ValueAtKey(dictionary=code_block_10, key=code_block_19)
createExcavationSolid = Custom[CreateExcavationSolid](Element=valueAtKey_4)  # CreateExcavationSolidForISOFDN
code_block_20 = CodeBlock { "TargetElements"; }
valueAtKey_5 = DesignScript.Builtin.Dictionary.ValueAtKey(dictionary=code_block_11, key=code_block_20)
createLeanConcrete = Custom[CreateLeanConcrete](Element=valueAtKey_5)  # CreateLeanConcreteForISOFDN
code_block_21 = CodeBlock { "TargetElements"; }
valueAtKey_6 = DesignScript.Builtin.Dictionary.ValueAtKey(dictionary=code_block_13, key=code_block_21)
extractSideFacesOfElement = Custom[ExtractSideFacesOfElement](Element=valueAtKey_6)  # ExtractSideFacesOfElement
code_block_22 = CodeBlock { "TargetElements"; }
valueAtKey_7 = DesignScript.Builtin.Dictionary.ValueAtKey(dictionary=code_block_14, key=code_block_22)
code_block_23 = CodeBlock(Element=valueAtKey_7) { _Element; }
extractUpperFacesOfElement = Custom[ExtractUpperFacesOfElement](Element=code_block_23)  # ExtractUpperFacesOfElement
flatten = List.Flatten(list=extractUpperFacesOfElement.Surface)
getJoinedElements = Element.GetJoinedElements(element=code_block_23)
flatten_2 = List.Flatten(list=getJoinedElements)
extractBelowFacesOfElement = Custom[ExtractBelowFacesOfElement](Element=flatten_2)  # ExtractBelowFacesOfElement
flatten_3 = List.Flatten(list=extractBelowFacesOfElement.Surface)
doesIntersect = Geometry.DoesIntersect(geometry=flatten_3, other=flatten, lacing=CrossProduct)
code_block_24 = CodeBlock { true; }
allIndicesOf = List.AllIndicesOf(list=doesIntersect@L2, item=code_block_24)
flatten_4 = List.Flatten(list=allIndicesOf)
groupByKey = List.GroupByKey(list=flatten_3, keys=flatten_4)
difference = Surface.Difference(surface=flatten, others=groupByKey.groups)
extractSideFacesOfElement_2 = Custom[ExtractSideFacesOfElement](Element=code_block_23)
addItemToFront = List.AddItemToFront(item=difference@L1, list=extractSideFacesOfElement_2.Surface@L2)
color_palette = ColorPalette({R: 30, G: 144, B: 255, A: 129})
byGeometryColor = Modifiers.GeometryColor.ByGeometryColor(geometry=addItemToFront, color=color_palette)

# group: See Result
code_block_25 = CodeBlock(SeeResult=createBaseCourseSurfaces.GeometryColor) { SeeResult; }
code_block_26 = CodeBlock(SeeResult=createExcavationSolid.GeometryColor) { SeeResult; }
code_block_27 = CodeBlock(SeeResult=createLeanConcrete.GeometryColor) { SeeResult; }
code_block_28 = CodeBlock(SeeResult=extractSideFacesOfElement.GeometryColor) { SeeResult; }
code_block_29 = CodeBlock(SeeResult=byGeometryColor) { SeeResult; }

# group: Distributer
code_block_30 = CodeBlock { i; }  # unwired: i
code_block_31 = CodeBlock(i=code_block_30) { i; }
code_block_32 = CodeBlock(i=code_block_31) { i; }
code_block_33 = CodeBlock(i=code_block_31) { i; }
code_block_34 = CodeBlock(i=code_block_30) { i; }
code_block_35 = CodeBlock(i=code_block_34) { i; }
code_block_36 = CodeBlock(i=code_block_30) { i; }
code_block_37 = CodeBlock(i=code_block_36) { i; }
code_block_38 = CodeBlock(i=code_block_30) { i; }
code_block_39 = CodeBlock(i=code_block_38) { i; }
code_block_40 = CodeBlock(i=code_block_31) { i; }
code_block_41 = CodeBlock(i=code_block_36) { i; }
code_block_42 = CodeBlock(i=code_block_36) { i; }
code_block_43 = CodeBlock(i=code_block_38) { i; }
code_block_44 = CodeBlock(i=code_block_38) { i; }
code_block_45 = CodeBlock(i=code_block_34) { i; }

code_block_46 = CodeBlock { "TargetElements"; }
valueAtKey_8 = DesignScript.Builtin.Dictionary.ValueAtKey(dictionary=code_block_32, key=code_block_46)
extractUpperFacesOfElement_2 = Custom[ExtractUpperFacesOfElement](Element=valueAtKey_8)

# group: <Func 2> - 수정필요
code_block_47 = CodeBlock { "TargetElements"; }
valueAtKey_9 = DesignScript.Builtin.Dictionary.ValueAtKey(dictionary=code_block_33, key=code_block_47)
# note: <Func>
extractSideFacesOfElement_3 = Custom[ExtractSideFacesOfElement](Element=valueAtKey_9)
area = Surface.Area(surface=extractSideFacesOfElement_3.Surface)
sum = Math.Sum(values=area)
code_block_48 = CodeBlock(i=sum) { Math.Round(List.Flatten(i)/1000000, 2); }
code_block_49 = CodeBlock { "M2"; }
count = List.Count(list=code_block_48)
ofRepeatedItem = List.OfRepeatedItem(item=code_block_49, amount=count)
code_block_50 = CodeBlock(FuncValues=code_block_48, FuncValuesUnit=ofRepeatedItem)
# ---------- code_block_50.designscript (4 lines) ----------
{
"FuncValues": _FuncValues,
"FuncValuesUnit": _FuncValuesUnit
};
# ----------------------------------------

code_block_51 = CodeBlock { "TargetElements"; }
valueAtKey_10 = DesignScript.Builtin.Dictionary.ValueAtKey(dictionary=code_block_35, key=code_block_51)
code_block_52 = CodeBlock { 0; 100; }
createLeanConcrete_2 = Custom[CreateLeanConcrete](Element=valueAtKey_10, leanOffset=code_block_52.out0, leanThick=code_block_52.out1)
code_block_53 = CodeBlock { "TargetElements"; }
valueAtKey_11 = DesignScript.Builtin.Dictionary.ValueAtKey(dictionary=code_block_37, key=code_block_53)
code_block_54 = CodeBlock { 0; }
createExcavationSolid_2 = Custom[CreateExcavationSolid](Element=valueAtKey_11, ExcavOffsetTop=code_block_54, ExcavOffsetBottom=code_block_54)
code_block_55 = CodeBlock { "TargetElements"; }
valueAtKey_12 = DesignScript.Builtin.Dictionary.ValueAtKey(dictionary=code_block_39, key=code_block_55)
createBaseCourseSurfaces_2 = Custom[CreateBaseCourseSurfaces](Element=valueAtKey_12)

# group: See Result
code_block_56 = CodeBlock(SeeResult=extractUpperFacesOfElement_2.GeometryColor) { SeeResult; }
code_block_57 = CodeBlock(SeeResult=extractSideFacesOfElement_3.GeometryColor) { SeeResult; }
code_block_58 = CodeBlock(SeeResult=createLeanConcrete_2.GeometryColor) { SeeResult; }
code_block_59 = CodeBlock(SeeResult=createExcavationSolid_2.GeometryColor) { SeeResult; }
code_block_60 = CodeBlock(SeeResult=createBaseCourseSurfaces_2.GeometryColor) { SeeResult; }

# group: Primary Input
categories = Categories("OST_Roofs")
all_elements_of_category = ElementsOfCategory(Category=categories)
file_path = Filename(".\BIM_물량집계 자동화 산출기준표_rC(20210729).xlsx")
file_from_path = FileObject(path=file_path)
code_block_61 = CodeBlock { "Roofs"; }

# group: GetFull WMCodeDescription PerElement
getFullWMCodeDescriptionPerElement = Custom[GetFullWMCodeDescriptionPerElement](InputElement=all_elements_of_category, InputFilePath=file_from_path, InputSheetName=code_block_61)  # GetFullWMCodeDescriptionPerElement

# group: OrganizeAllElementInformAsDictionary
organizeAllElementInformAsDictionary = Custom[OrganizeAllElementInformAsDictionary](InputDic=getFullWMCodeDescriptionPerElement.Dictionary)  # OrganizeAllElementInformAsDictionary

# group: Select Target Family Element And Connected WorkMasters
code_block_62 = CodeBlock { 2; }
selectTargetFamilyInformAsDictionary_2 = Custom[SelectTargetFamilyInformAsDictionary](InputIndex=code_block_62)  # unwired: InputDic

# group: Distributer
code_block_63 = CodeBlock(i=selectTargetFamilyInformAsDictionary_2) { i; }
code_block_64 = CodeBlock(i=code_block_63) { i; }
code_block_65 = CodeBlock(i=code_block_64) { i; }
code_block_66 = CodeBlock(i=code_block_64) { i; }
code_block_67 = CodeBlock(i=code_block_63) { i; }
code_block_68 = CodeBlock(i=code_block_67) { i; }
code_block_69 = CodeBlock(i=code_block_63) { i; }
code_block_70 = CodeBlock(i=code_block_69) { i; }
code_block_71 = CodeBlock(i=code_block_63) { i; }
code_block_72 = CodeBlock(i=code_block_71) { i; }
code_block_73 = CodeBlock(i=code_block_64) { i; }
code_block_74 = CodeBlock(i=code_block_69) { i; }
code_block_75 = CodeBlock(i=code_block_69) { i; }
code_block_76 = CodeBlock(i=code_block_71) { i; }
code_block_77 = CodeBlock(i=code_block_71) { i; }
code_block_78 = CodeBlock(i=code_block_67) { i; }

code_block_79 = CodeBlock { "TargetElements"; }
valueAtKey_13 = DesignScript.Builtin.Dictionary.ValueAtKey(dictionary=code_block_65, key=code_block_79)
extractUpperFacesOfElement_3 = Custom[ExtractUpperFacesOfElement](Element=valueAtKey_13)

# group: <Func 2> - 수정필요
code_block_80 = CodeBlock { "TargetElements"; }
valueAtKey_14 = DesignScript.Builtin.Dictionary.ValueAtKey(dictionary=code_block_66, key=code_block_80)
# note: <Func>
extractSideFacesOfElement_4 = Custom[ExtractSideFacesOfElement](Element=valueAtKey_14)
area_2 = Surface.Area(surface=extractSideFacesOfElement_4.Surface)
sum_2 = Math.Sum(values=area_2)
code_block_81 = CodeBlock(i=sum_2) { Math.Round(List.Flatten(i)/1000000, 2); }
code_block_82 = CodeBlock { "M2"; }
count_2 = List.Count(list=code_block_81)
ofRepeatedItem_2 = List.OfRepeatedItem(item=code_block_82, amount=count_2)
code_block_83 = CodeBlock(FuncValues=code_block_81, FuncValuesUnit=ofRepeatedItem_2)  # same code as code_block_50

code_block_84 = CodeBlock { "TargetElements"; }
valueAtKey_15 = DesignScript.Builtin.Dictionary.ValueAtKey(dictionary=code_block_68, key=code_block_84)
code_block_85 = CodeBlock { 0; 100; }
createLeanConcrete_3 = Custom[CreateLeanConcrete](Element=valueAtKey_15, leanOffset=code_block_85.out0, leanThick=code_block_85.out1)
code_block_86 = CodeBlock { "TargetElements"; }
valueAtKey_16 = DesignScript.Builtin.Dictionary.ValueAtKey(dictionary=code_block_70, key=code_block_86)
code_block_87 = CodeBlock { 0; }
createExcavationSolid_3 = Custom[CreateExcavationSolid](Element=valueAtKey_16, ExcavOffsetTop=code_block_87, ExcavOffsetBottom=code_block_87)
code_block_88 = CodeBlock { "TargetElements"; }
valueAtKey_17 = DesignScript.Builtin.Dictionary.ValueAtKey(dictionary=code_block_72, key=code_block_88)
createBaseCourseSurfaces_3 = Custom[CreateBaseCourseSurfaces](Element=valueAtKey_17)

# group: See Result
code_block_89 = CodeBlock(SeeResult=extractUpperFacesOfElement_3.GeometryColor) { SeeResult; }
code_block_90 = CodeBlock(SeeResult=extractSideFacesOfElement_4.GeometryColor) { SeeResult; }
code_block_91 = CodeBlock(SeeResult=createLeanConcrete_3.GeometryColor) { SeeResult; }
code_block_92 = CodeBlock(SeeResult=createExcavationSolid_3.GeometryColor) { SeeResult; }
code_block_93 = CodeBlock(SeeResult=createBaseCourseSurfaces_3.GeometryColor) { SeeResult; }

code_block_94 = CodeBlock { "TargetElements"; }
valueAtKey_18 = DesignScript.Builtin.Dictionary.ValueAtKey(dictionary=code_block_15, key=code_block_94)
code_block_95 = CodeBlock { "Volume"; }
getParameterValueByName = Element.GetParameterValueByName(element=valueAtKey_18, parameterName=code_block_95)
code_block_96 = CodeBlock(i=getParameterValueByName) { Math.Round(List.Flatten(i)/1, 2); }
code_block_97 = CodeBlock { "M3"; }
count_3 = List.Count(list=code_block_96)
ofRepeatedItem_3 = List.OfRepeatedItem(item=code_block_97, amount=count_3)
code_block_98 = CodeBlock(FuncValues=code_block_96, FuncValuesUnit=ofRepeatedItem_3)  # same code as code_block_50
volume = Solid.Volume(solid=createExcavationSolid.Solid)
code_block_99 = CodeBlock(i=volume) { Math.Round(List.Flatten(i)/1000000000, 2); }
code_block_100 = CodeBlock { "M3"; }
count_4 = List.Count(list=code_block_99)
ofRepeatedItem_4 = List.OfRepeatedItem(item=code_block_100, amount=count_4)
code_block_101 = CodeBlock(FuncValues=code_block_99, FuncValuesUnit=ofRepeatedItem_4)  # same code as code_block_50
area_3 = Surface.Area(surface=createBaseCourseSurfaces.Surface)
code_block_102 = CodeBlock(i=area_3) { Math.Round(List.Flatten(i)/1000000, 2); }
code_block_103 = CodeBlock { "M2"; }
count_5 = List.Count(list=code_block_102)
ofRepeatedItem_5 = List.OfRepeatedItem(item=code_block_103, amount=count_5)
code_block_104 = CodeBlock(FuncValues=code_block_102, FuncValuesUnit=ofRepeatedItem_5)  # same code as code_block_50
volume_2 = Solid.Volume(solid=createLeanConcrete.Solid)
code_block_105 = CodeBlock(i=volume_2) { Math.Round(List.Flatten(i)/1000000000, 2); }
code_block_106 = CodeBlock { "M3"; }
count_6 = List.Count(list=code_block_105)
ofRepeatedItem_6 = List.OfRepeatedItem(item=code_block_106, amount=count_6)
code_block_107 = CodeBlock(FuncValues=code_block_105, FuncValuesUnit=ofRepeatedItem_6)  # same code as code_block_50
area_4 = Surface.Area(surface=extractSideFacesOfElement.Surface)
sum_3 = Math.Sum(values=area_4)
code_block_108 = CodeBlock(i=sum_3) { Math.Round(List.Flatten(i)/1000000, 2); }
code_block_109 = CodeBlock { "M2"; }
count_7 = List.Count(list=code_block_108)
ofRepeatedItem_7 = List.OfRepeatedItem(item=code_block_109, amount=count_7)
code_block_110 = CodeBlock(FuncValues=code_block_108, FuncValuesUnit=ofRepeatedItem_7)  # same code as code_block_50
code_block_111 = CodeBlock { "TargetElements"; }
valueAtKey_19 = DesignScript.Builtin.Dictionary.ValueAtKey(dictionary=code_block_16, key=code_block_111)
code_block_112 = CodeBlock { "Volume"; }
getParameterValueByName_2 = Element.GetParameterValueByName(element=valueAtKey_19, parameterName=code_block_112)
code_block_113 = CodeBlock { 0.1; }
mul = getParameterValueByName_2 * code_block_113
code_block_114 = CodeBlock(i=mul) { Math.Round(List.Flatten(i)/1, 2); }
code_block_115 = CodeBlock { "TON"; }
count_8 = List.Count(list=code_block_114)
ofRepeatedItem_8 = List.OfRepeatedItem(item=code_block_115, amount=count_8)
code_block_116 = CodeBlock(FuncValues=code_block_114, FuncValuesUnit=ofRepeatedItem_8)  # same code as code_block_50
code_block_117 = CodeBlock { "TargetElements"; }
valueAtKey_20 = DesignScript.Builtin.Dictionary.ValueAtKey(dictionary=code_block_17, key=code_block_117)
createLeanConcrete_4 = Custom[CreateLeanConcrete](Element=valueAtKey_20)
area_5 = Surface.Area(surface=createLeanConcrete_4.Surface)
code_block_118 = CodeBlock(i=area_5) { Math.Round(List.Flatten(i)/1000000, 2); }
code_block_119 = CodeBlock { "M2"; }
count_9 = List.Count(list=code_block_118)
ofRepeatedItem_9 = List.OfRepeatedItem(item=code_block_119, amount=count_9)
code_block_120 = CodeBlock(FuncValues=code_block_118, FuncValuesUnit=ofRepeatedItem_9)  # same code as code_block_50
area_6 = Surface.Area(surface=addItemToFront)
sum_4 = Math.Sum(values=area_6)
code_block_121 = CodeBlock(i=sum_4) { Math.Round(List.Flatten(i)/1000000, 2); }
code_block_122 = CodeBlock { "M2"; }
count_10 = List.Count(list=code_block_121)
ofRepeatedItem_10 = List.OfRepeatedItem(item=code_block_122, amount=count_10)
code_block_123 = CodeBlock(FuncValues=code_block_121, FuncValuesUnit=ofRepeatedItem_10)  # same code as code_block_50
join = List.Join(list0=code_block_98, list1=code_block_101, list2=code_block_104, list3=code_block_107, list4=code_block_110, list5=code_block_116, list6=code_block_120, list7=code_block_123)

# group: TargetWMunique + Data Sending
code_block_124 = CodeBlock(InputDic2=join) { _InputDic2; }
count_11 = List.Count(list=code_block_124)
code_block_125 = CodeBlock(InputDic1=code_block_7) { _InputDic1; }
code_block_126 = CodeBlock { "TargetWMunique"; }
valueAtKey_21 = DesignScript.Builtin.Dictionary.ValueAtKey(dictionary=code_block_125, key=code_block_126)
watch = Watch(valueAtKey_21)
count_12 = List.Count(list=watch)
eq = count_11 == count_12
organizeFuncValuesAndWorkMasterAsDiction = Custom[OrganizeFuncValuesAndWorkMasterAsDictionary](InputDic1=code_block_125, InputDic2=code_block_124)  # Organize FuncValues and WorkMaster As Dictionary
watch_2 = Watch()  # unwired: arg0
if_ = If(test=eq, true=organizeFuncValuesAndWorkMasterAsDiction, false=watch_2)

# group: 데이터 취합 및 Row 방향 정렬
code_block_127 = CodeBlock(InputDic=if_) { _InputDic; }
code_block_128 = CodeBlock { "TrTargetFamilyCode"; }
valueAtKey_22 = DesignScript.Builtin.Dictionary.ValueAtKey(dictionary=code_block_127, key=code_block_128)
watch_3 = Watch(valueAtKey_22)
flatten_5 = List.Flatten(list=watch_3)
code_block_129 = CodeBlock { "WMforTargetElements"; }
valueAtKey_23 = DesignScript.Builtin.Dictionary.ValueAtKey(dictionary=code_block_127, key=code_block_129)
watch_4 = Watch(valueAtKey_23)
flatten_6 = List.Flatten(list=watch_4)
code_block_130 = CodeBlock { "TargetFuncValues"; }
valueAtKey_24 = DesignScript.Builtin.Dictionary.ValueAtKey(dictionary=code_block_127, key=code_block_130)
watch_5 = Watch(valueAtKey_24)
flatten_7 = List.Flatten(list=watch_5)
code_block_131 = CodeBlock { "TargetFuncValuesUnit"; }
valueAtKey_25 = DesignScript.Builtin.Dictionary.ValueAtKey(dictionary=code_block_127, key=code_block_131)
watch_6 = Watch(valueAtKey_25)
flatten_8 = List.Flatten(list=watch_6)
list_create = List.Create(item0=flatten_5, item1=flatten_6, item2=flatten_7, item3=flatten_8)
transpose = List.Transpose(lists=list_create)

area_7 = Surface.Area(surface=extractUpperFacesOfElement_2.Surface)
sum_5 = Math.Sum(values=area_7)
code_block_132 = CodeBlock(i=sum_5) { Math.Round(List.Flatten(i)/1000000, 2); }
code_block_133 = CodeBlock { "M3"; }
count_13 = List.Count(list=code_block_132)
ofRepeatedItem_11 = List.OfRepeatedItem(item=code_block_133, amount=count_13)
code_block_134 = CodeBlock(FuncValues=code_block_132, FuncValuesUnit=ofRepeatedItem_11)  # same code as code_block_50
code_block_135 = CodeBlock { "TargetElements"; }
valueAtKey_26 = DesignScript.Builtin.Dictionary.ValueAtKey(dictionary=code_block_40, key=code_block_135)
code_block_136 = CodeBlock { "Volume"; }
getParameterValueByName_3 = Element.GetParameterValueByName(element=valueAtKey_26, parameterName=code_block_136)
code_block_137 = CodeBlock(i=getParameterValueByName_3) { Math.Round(List.Flatten(i)/1000000, 2); }
code_block_138 = CodeBlock { "M3"; }
count_14 = List.Count(list=code_block_137)
ofRepeatedItem_12 = List.OfRepeatedItem(item=code_block_138, amount=count_14)
code_block_139 = CodeBlock(FuncValues=code_block_137, FuncValuesUnit=ofRepeatedItem_12)  # same code as code_block_50
code_block_140 = CodeBlock { "TargetElements"; }
valueAtKey_27 = DesignScript.Builtin.Dictionary.ValueAtKey(dictionary=code_block_41, key=code_block_140)
createLeanConcrete_5 = Custom[CreateLeanConcrete](Element=valueAtKey_27)
area_8 = Surface.Area(surface=createLeanConcrete_5.Surface)
code_block_141 = CodeBlock(i=area_8) { Math.Round(List.Flatten(i)/1000000, 2); }
code_block_142 = CodeBlock { "M2"; }
count_15 = List.Count(list=code_block_141)
ofRepeatedItem_13 = List.OfRepeatedItem(item=code_block_142, amount=count_15)
code_block_143 = CodeBlock(FuncValues=code_block_141, FuncValuesUnit=ofRepeatedItem_13)  # same code as code_block_50
map = List.Map()  # unwired: list, function
isNull = Object.IsNull(object=createExcavationSolid_2.Solid)
code_block_144 = CodeBlock { 1; }
mul_2 = _ * code_block_144  # unwired: x
volume_3 = Solid.Volume()  # unwired: solid
if_2 = If(test=isNull, true=mul_2, false=volume_3)
code_block_145 = CodeBlock { 0; }
isNull_2 = Object.IsNull()  # unwired: object
replaceByCondition = Replace(item=createExcavationSolid_2.Solid, replaceWith=code_block_145, condition=isNull_2)
laceShortest = List.LaceShortest(combineFunction=map, list0=if_2, list1=replaceByCondition)
code_block_146 = CodeBlock(i=laceShortest) { Math.Round(List.Flatten(i)/1000000000, 2); }
code_block_147 = CodeBlock { "M3"; }
count_16 = List.Count(list=code_block_146)
ofRepeatedItem_14 = List.OfRepeatedItem(item=code_block_147, amount=count_16)
code_block_148 = CodeBlock(FuncValues=code_block_146, FuncValuesUnit=ofRepeatedItem_14)  # same code as code_block_50
code_block_149 = CodeBlock { 0; }
code_block_150 = CodeBlock { "TargetElements"; }
valueAtKey_28 = DesignScript.Builtin.Dictionary.ValueAtKey(dictionary=code_block_42, key=code_block_150)
count_17 = List.Count(list=valueAtKey_28@L1)
ofRepeatedItem_15 = List.OfRepeatedItem(item=code_block_149, amount=count_17)
code_block_151 = CodeBlock(i=ofRepeatedItem_15) { Math.Round(List.Flatten(i)/1000000000, 2); }
code_block_152 = CodeBlock { "M3"; }
count_18 = List.Count(list=code_block_151)
ofRepeatedItem_16 = List.OfRepeatedItem(item=code_block_152, amount=count_18)
code_block_153 = CodeBlock(FuncValues=code_block_151, FuncValuesUnit=ofRepeatedItem_16)  # same code as code_block_50
code_block_154 = CodeBlock { 0; }
code_block_155 = CodeBlock { "TargetElements"; }
valueAtKey_29 = DesignScript.Builtin.Dictionary.ValueAtKey(dictionary=code_block_43, key=code_block_155)
count_19 = List.Count(list=valueAtKey_29@L1)
ofRepeatedItem_17 = List.OfRepeatedItem(item=code_block_154, amount=count_19)
code_block_156 = CodeBlock(i=ofRepeatedItem_17) { Math.Round(List.Flatten(i)/1000000000, 2); }
code_block_157 = CodeBlock { "M3"; }
count_20 = List.Count(list=code_block_156)
ofRepeatedItem_18 = List.OfRepeatedItem(item=code_block_157, amount=count_20)
code_block_158 = CodeBlock(FuncValues=code_block_156, FuncValuesUnit=ofRepeatedItem_18)  # same code as code_block_50
area_9 = Surface.Area(surface=createBaseCourseSurfaces_2.Surface)
code_block_159 = CodeBlock(i=area_9) { Math.Round(List.Flatten(i)/1000000, 2); }
code_block_160 = CodeBlock { "M2"; }
count_21 = List.Count(list=code_block_159)
ofRepeatedItem_19 = List.OfRepeatedItem(item=code_block_160, amount=count_21)
code_block_161 = CodeBlock(FuncValues=code_block_159, FuncValuesUnit=ofRepeatedItem_19)  # same code as code_block_50
code_block_162 = CodeBlock { 0; }
code_block_163 = CodeBlock { "TargetElements"; }
valueAtKey_30 = DesignScript.Builtin.Dictionary.ValueAtKey(dictionary=code_block_44, key=code_block_163)
count_22 = List.Count(list=valueAtKey_30@L1)
ofRepeatedItem_20 = List.OfRepeatedItem(item=code_block_162, amount=count_22)
code_block_164 = CodeBlock(i=ofRepeatedItem_20) { Math.Round(List.Flatten(i)/1000000000, 2); }
code_block_165 = CodeBlock { "M3"; }
count_23 = List.Count(list=code_block_164)
ofRepeatedItem_21 = List.OfRepeatedItem(item=code_block_165, amount=count_23)
code_block_166 = CodeBlock(FuncValues=code_block_164, FuncValuesUnit=ofRepeatedItem_21)  # same code as code_block_50
volume_4 = Solid.Volume(solid=createLeanConcrete_2.Solid)
code_block_167 = CodeBlock(i=volume_4) { Math.Round(List.Flatten(i)/1000000000, 2); }
code_block_168 = CodeBlock { "M3"; }
count_24 = List.Count(list=code_block_167)
ofRepeatedItem_22 = List.OfRepeatedItem(item=code_block_168, amount=count_24)
code_block_169 = CodeBlock(FuncValues=code_block_167, FuncValuesUnit=ofRepeatedItem_22)  # same code as code_block_50
code_block_170 = CodeBlock { "TargetElements"; }
valueAtKey_31 = DesignScript.Builtin.Dictionary.ValueAtKey(dictionary=code_block_45, key=code_block_170)
code_block_171 = CodeBlock { "Volume"; }
getParameterValueByName_4 = Element.GetParameterValueByName(element=valueAtKey_31, parameterName=code_block_171)
code_block_172 = CodeBlock { 0.1; }
mul_3 = getParameterValueByName_4 * code_block_172
code_block_173 = CodeBlock(i=mul_3) { Math.Round(List.Flatten(i)/1, 2); }
code_block_174 = CodeBlock { "TON"; }
count_25 = List.Count(list=code_block_173)
ofRepeatedItem_23 = List.OfRepeatedItem(item=code_block_174, amount=count_25)
code_block_175 = CodeBlock(FuncValues=code_block_173, FuncValuesUnit=ofRepeatedItem_23)  # same code as code_block_50
join_2 = List.Join(list0=code_block_134, list1=code_block_139, list2=code_block_50, list3=code_block_143, list4=code_block_148, list5=code_block_153, list6=code_block_158, list7=code_block_161, list8=code_block_166, list9=code_block_169, list10=code_block_175)

# group: TargetWMunique + Data Sending
code_block_176 = CodeBlock(InputDic2=join_2) { _InputDic2; }
count_26 = List.Count(list=code_block_176)
code_block_177 = CodeBlock(InputDic1=code_block_30) { _InputDic1; }
code_block_178 = CodeBlock { "TargetWMunique"; }
valueAtKey_32 = DesignScript.Builtin.Dictionary.ValueAtKey(dictionary=code_block_177, key=code_block_178)
watch_7 = Watch(valueAtKey_32)
count_27 = List.Count(list=watch_7)
eq_2 = count_26 == count_27
organizeFuncValuesAndWorkMasterAsDiction_2 = Custom[OrganizeFuncValuesAndWorkMasterAsDictionary](InputDic1=code_block_177, InputDic2=code_block_176)
watch_8 = Watch()  # unwired: arg0
if_3 = If(test=eq_2, true=organizeFuncValuesAndWorkMasterAsDiction_2, false=watch_8)

# group: 데이터 취합 및 Row 방향 정렬
code_block_179 = CodeBlock(InputDic=if_3) { _InputDic; }
code_block_180 = CodeBlock { "TrTargetFamilyCode"; }
valueAtKey_33 = DesignScript.Builtin.Dictionary.ValueAtKey(dictionary=code_block_179, key=code_block_180)
watch_9 = Watch(valueAtKey_33)
flatten_9 = List.Flatten(list=watch_9)
code_block_181 = CodeBlock { "WMforTargetElements"; }
valueAtKey_34 = DesignScript.Builtin.Dictionary.ValueAtKey(dictionary=code_block_179, key=code_block_181)
watch_10 = Watch(valueAtKey_34)
flatten_10 = List.Flatten(list=watch_10)
code_block_182 = CodeBlock { "TargetFuncValues"; }
valueAtKey_35 = DesignScript.Builtin.Dictionary.ValueAtKey(dictionary=code_block_179, key=code_block_182)
watch_11 = Watch(valueAtKey_35)
flatten_11 = List.Flatten(list=watch_11)
code_block_183 = CodeBlock { "TargetFuncValuesUnit"; }
valueAtKey_36 = DesignScript.Builtin.Dictionary.ValueAtKey(dictionary=code_block_179, key=code_block_183)
watch_12 = Watch(valueAtKey_36)
flatten_12 = List.Flatten(list=watch_12)
list_create_2 = List.Create(item0=flatten_9, item1=flatten_10, item2=flatten_11, item3=flatten_12)
transpose_2 = List.Transpose(lists=list_create_2)

area_10 = Surface.Area(surface=extractUpperFacesOfElement_3.Surface)
sum_6 = Math.Sum(values=area_10)
code_block_184 = CodeBlock(i=sum_6) { Math.Round(List.Flatten(i)/1000000, 2); }
code_block_185 = CodeBlock { "M3"; }
count_28 = List.Count(list=code_block_184)
ofRepeatedItem_24 = List.OfRepeatedItem(item=code_block_185, amount=count_28)
code_block_186 = CodeBlock(FuncValues=code_block_184, FuncValuesUnit=ofRepeatedItem_24)  # same code as code_block_50
code_block_187 = CodeBlock { "TargetElements"; }
valueAtKey_37 = DesignScript.Builtin.Dictionary.ValueAtKey(dictionary=code_block_73, key=code_block_187)
code_block_188 = CodeBlock { "Volume"; }
getParameterValueByName_5 = Element.GetParameterValueByName(element=valueAtKey_37, parameterName=code_block_188)
code_block_189 = CodeBlock(i=getParameterValueByName_5) { Math.Round(List.Flatten(i)/1000000, 2); }
code_block_190 = CodeBlock { "M3"; }
count_29 = List.Count(list=code_block_189)
ofRepeatedItem_25 = List.OfRepeatedItem(item=code_block_190, amount=count_29)
code_block_191 = CodeBlock(FuncValues=code_block_189, FuncValuesUnit=ofRepeatedItem_25)  # same code as code_block_50
code_block_192 = CodeBlock { "TargetElements"; }
valueAtKey_38 = DesignScript.Builtin.Dictionary.ValueAtKey(dictionary=code_block_74, key=code_block_192)
createLeanConcrete_6 = Custom[CreateLeanConcrete](Element=valueAtKey_38)
area_11 = Surface.Area(surface=createLeanConcrete_6.Surface)
code_block_193 = CodeBlock(i=area_11) { Math.Round(List.Flatten(i)/1000000, 2); }
code_block_194 = CodeBlock { "M2"; }
count_30 = List.Count(list=code_block_193)
ofRepeatedItem_26 = List.OfRepeatedItem(item=code_block_194, amount=count_30)
code_block_195 = CodeBlock(FuncValues=code_block_193, FuncValuesUnit=ofRepeatedItem_26)  # same code as code_block_50
map_2 = List.Map()  # unwired: list, function
isNull_3 = Object.IsNull(object=createExcavationSolid_3.Solid)
code_block_196 = CodeBlock { 1; }
mul_4 = _ * code_block_196  # unwired: x
volume_5 = Solid.Volume()  # unwired: solid
if_4 = If(test=isNull_3, true=mul_4, false=volume_5)
code_block_197 = CodeBlock { 0; }
isNull_4 = Object.IsNull()  # unwired: object
replaceByCondition_2 = Replace(item=createExcavationSolid_3.Solid, replaceWith=code_block_197, condition=isNull_4)
laceShortest_2 = List.LaceShortest(combineFunction=map_2, list0=if_4, list1=replaceByCondition_2)
code_block_198 = CodeBlock(i=laceShortest_2) { Math.Round(List.Flatten(i)/1000000000, 2); }
code_block_199 = CodeBlock { "M3"; }
count_31 = List.Count(list=code_block_198)
ofRepeatedItem_27 = List.OfRepeatedItem(item=code_block_199, amount=count_31)
code_block_200 = CodeBlock(FuncValues=code_block_198, FuncValuesUnit=ofRepeatedItem_27)  # same code as code_block_50
code_block_201 = CodeBlock { 0; }
code_block_202 = CodeBlock { "TargetElements"; }
valueAtKey_39 = DesignScript.Builtin.Dictionary.ValueAtKey(dictionary=code_block_75, key=code_block_202)
count_32 = List.Count(list=valueAtKey_39@L1)
ofRepeatedItem_28 = List.OfRepeatedItem(item=code_block_201, amount=count_32)
code_block_203 = CodeBlock(i=ofRepeatedItem_28) { Math.Round(List.Flatten(i)/1000000000, 2); }
code_block_204 = CodeBlock { "M3"; }
count_33 = List.Count(list=code_block_203)
ofRepeatedItem_29 = List.OfRepeatedItem(item=code_block_204, amount=count_33)
code_block_205 = CodeBlock(FuncValues=code_block_203, FuncValuesUnit=ofRepeatedItem_29)  # same code as code_block_50
code_block_206 = CodeBlock { 0; }
code_block_207 = CodeBlock { "TargetElements"; }
valueAtKey_40 = DesignScript.Builtin.Dictionary.ValueAtKey(dictionary=code_block_76, key=code_block_207)
count_34 = List.Count(list=valueAtKey_40@L1)
ofRepeatedItem_30 = List.OfRepeatedItem(item=code_block_206, amount=count_34)
code_block_208 = CodeBlock(i=ofRepeatedItem_30) { Math.Round(List.Flatten(i)/1000000000, 2); }
code_block_209 = CodeBlock { "M3"; }
count_35 = List.Count(list=code_block_208)
ofRepeatedItem_31 = List.OfRepeatedItem(item=code_block_209, amount=count_35)
code_block_210 = CodeBlock(FuncValues=code_block_208, FuncValuesUnit=ofRepeatedItem_31)  # same code as code_block_50
area_12 = Surface.Area(surface=createBaseCourseSurfaces_3.Surface)
code_block_211 = CodeBlock(i=area_12) { Math.Round(List.Flatten(i)/1000000, 2); }
code_block_212 = CodeBlock { "M2"; }
count_36 = List.Count(list=code_block_211)
ofRepeatedItem_32 = List.OfRepeatedItem(item=code_block_212, amount=count_36)
code_block_213 = CodeBlock(FuncValues=code_block_211, FuncValuesUnit=ofRepeatedItem_32)  # same code as code_block_50
code_block_214 = CodeBlock { 0; }
code_block_215 = CodeBlock { "TargetElements"; }
valueAtKey_41 = DesignScript.Builtin.Dictionary.ValueAtKey(dictionary=code_block_77, key=code_block_215)
count_37 = List.Count(list=valueAtKey_41@L1)
ofRepeatedItem_33 = List.OfRepeatedItem(item=code_block_214, amount=count_37)
code_block_216 = CodeBlock(i=ofRepeatedItem_33) { Math.Round(List.Flatten(i)/1000000000, 2); }
code_block_217 = CodeBlock { "M3"; }
count_38 = List.Count(list=code_block_216)
ofRepeatedItem_34 = List.OfRepeatedItem(item=code_block_217, amount=count_38)
code_block_218 = CodeBlock(FuncValues=code_block_216, FuncValuesUnit=ofRepeatedItem_34)  # same code as code_block_50
volume_6 = Solid.Volume(solid=createLeanConcrete_3.Solid)
code_block_219 = CodeBlock(i=volume_6) { Math.Round(List.Flatten(i)/1000000000, 2); }
code_block_220 = CodeBlock { "M3"; }
count_39 = List.Count(list=code_block_219)
ofRepeatedItem_35 = List.OfRepeatedItem(item=code_block_220, amount=count_39)
code_block_221 = CodeBlock(FuncValues=code_block_219, FuncValuesUnit=ofRepeatedItem_35)  # same code as code_block_50
code_block_222 = CodeBlock { "TargetElements"; }
valueAtKey_42 = DesignScript.Builtin.Dictionary.ValueAtKey(dictionary=code_block_78, key=code_block_222)
code_block_223 = CodeBlock { "Volume"; }
getParameterValueByName_6 = Element.GetParameterValueByName(element=valueAtKey_42, parameterName=code_block_223)
code_block_224 = CodeBlock { 0.1; }
mul_5 = getParameterValueByName_6 * code_block_224
code_block_225 = CodeBlock(i=mul_5) { Math.Round(List.Flatten(i)/1, 2); }
code_block_226 = CodeBlock { "TON"; }
count_40 = List.Count(list=code_block_225)
ofRepeatedItem_36 = List.OfRepeatedItem(item=code_block_226, amount=count_40)
code_block_227 = CodeBlock(FuncValues=code_block_225, FuncValuesUnit=ofRepeatedItem_36)  # same code as code_block_50
join_3 = List.Join(list0=code_block_186, list1=code_block_191, list2=code_block_83, list3=code_block_195, list4=code_block_200, list5=code_block_205, list6=code_block_210, list7=code_block_213, list8=code_block_218, list9=code_block_221, list10=code_block_227)

# group: TargetWMunique + Data Sending
code_block_228 = CodeBlock(InputDic2=join_3) { _InputDic2; }
count_41 = List.Count(list=code_block_228)
code_block_229 = CodeBlock(InputDic1=code_block_63) { _InputDic1; }
code_block_230 = CodeBlock { "TargetWMunique"; }
valueAtKey_43 = DesignScript.Builtin.Dictionary.ValueAtKey(dictionary=code_block_229, key=code_block_230)
watch_13 = Watch(valueAtKey_43)
count_42 = List.Count(list=watch_13)
eq_3 = count_41 == count_42
organizeFuncValuesAndWorkMasterAsDiction_3 = Custom[OrganizeFuncValuesAndWorkMasterAsDictionary](InputDic1=code_block_229, InputDic2=code_block_228)
watch_14 = Watch()  # unwired: arg0
if_5 = If(test=eq_3, true=organizeFuncValuesAndWorkMasterAsDiction_3, false=watch_14)

# group: 데이터 취합 및 Row 방향 정렬
code_block_231 = CodeBlock(InputDic=if_5) { _InputDic; }
code_block_232 = CodeBlock { "TrTargetFamilyCode"; }
valueAtKey_44 = DesignScript.Builtin.Dictionary.ValueAtKey(dictionary=code_block_231, key=code_block_232)
watch_15 = Watch(valueAtKey_44)
flatten_13 = List.Flatten(list=watch_15)
code_block_233 = CodeBlock { "WMforTargetElements"; }
valueAtKey_45 = DesignScript.Builtin.Dictionary.ValueAtKey(dictionary=code_block_231, key=code_block_233)
watch_16 = Watch(valueAtKey_45)
flatten_14 = List.Flatten(list=watch_16)
code_block_234 = CodeBlock { "TargetFuncValues"; }
valueAtKey_46 = DesignScript.Builtin.Dictionary.ValueAtKey(dictionary=code_block_231, key=code_block_234)
watch_17 = Watch(valueAtKey_46)
flatten_15 = List.Flatten(list=watch_17)
code_block_235 = CodeBlock { "TargetFuncValuesUnit"; }
valueAtKey_47 = DesignScript.Builtin.Dictionary.ValueAtKey(dictionary=code_block_231, key=code_block_235)
watch_18 = Watch(valueAtKey_47)
flatten_16 = List.Flatten(list=watch_18)
list_create_3 = List.Create(item0=flatten_13, item1=flatten_14, item2=flatten_15, item3=flatten_16)
transpose_3 = List.Transpose(lists=list_create_3)

# group: 패밀리 별 취합 + Export Excel(By OpenpyXl)
# note: Excel Export Button
boolean = BoolSelector(false)
join_4 = List.Join(list0=transpose, list1=transpose_2, list2=transpose_3)
watch_19 = Watch()  # unwired: arg0
if_6 = If(test=boolean, true=join_4, false=watch_19)
python_script_export_excel_by = Python(IN[0]=if_6)  # "Python Script@Export Excel(By OpenpyXl)"; CPython3
# ---------- python_script_export_excel_by.python (151 lines) ----------
# Load the Python Standard and DesignScript Libraries
import sys
import os
#sys.path.append(r'C:\Users\HEC\AppData\Local\Programs\Python\Python39\Lib\site-packages')
#sys.path.append(r'C:\Users\pjmk0\AppData\Local\Programs\Python\Python39\Lib\site-packages')
sys.path.append(os.getenv('LOCALAPPDATA').replace('\\','\\\\') + r'\Programs\Python\Python39\Lib\site-packages')
import clr
clr.AddReference('ProtoGeometry')
from Autodesk.DesignScript.Geometry import *
from collections import Iterable

def iterable(obj):
    return isinstance(obj, Iterable)


# The inputs to this node will be stored as a list in the IN variables.
dataEnteringNode = IN
ListIn = IN[0]

# Place your code below this line
import datetime
from datetime import date, timedelta
Today = date.today()
import openpyxl
from openpyxl.styles import Border, Side, PatternFill, Font, GradientFill, Alignment, Color, numbers

sample_items = ListIn


def write_to_file(filepath):
    wb = openpyxl.Workbook()
    for sheet in wb.sheetnames:
        wb.remove(wb[sheet])

    thin = Side(border_style="thin", color="000000")
    double = Side(border_style="double", color="000000")

    ws = wb.create_sheet(title='Wall_Calc_instance', index=0)

    ws.merge_cells('A1:L1')
    ws['A1'] = 'HEC Wall Category Calculation Sheet'
    cell = ws['A1']
    cell.font = openpyxl.styles.Font(color='000000', size=20)
    cell.fill = openpyxl.styles.fills.PatternFill(patternType='solid',
                                                  fgColor=openpyxl.styles.colors.Color(rgb='fff3b0'))

    ws['A2'] = 'Item Number'
    ws['A2'].font = openpyxl.styles.Font(b=True, color='000000', size=12)
    #ws['B2'] = 'Member Name'
    #ws['B2'].font = openpyxl.styles.Font(b=True, color='000000', size=12)
    #ws['C2'] = 'Category'
    #ws['C2'].font = openpyxl.styles.Font(b=True, color='000000', size=12)
    ws['B2'] = 'Family Type'
    ws['B2'].font = openpyxl.styles.Font(b=True, color='000000', size=12)
    ws['C2'] = 'WorkMaster Code'
    ws['C2'].font = openpyxl.styles.Font(b=True, color='000000', size=12)
    #ws['F2'] = 'WorkMaster Description'
    #ws['F2'].font = openpyxl.styles.Font(b=True, color='000000', size=12)
    #ws['G2'] = 'Unit'
    #ws['G2'].font = openpyxl.styles.Font(b=True, color='000000', size=12)
    #ws['H2'] = '계수'
    #ws['H2'].font = openpyxl.styles.Font(b=True, color='000000', size=12)
    #ws['I2'] = '계산 참조값'
    #ws['I2'].font = openpyxl.styles.Font(b=True, color='000000', size=12)
    ws['D2'] = 'Quantities'
    ws['D2'].font = openpyxl.styles.Font(b=True, color='000000', size=12)
    ws['E2'] = 'Unit'
    ws['E2'].font = openpyxl.styles.Font(b=True, color='000000', size=12)
    ws['F2'] = 'Unit Price'
    ws['F2'].font = openpyxl.styles.Font(b=True, color='000000', size=12)
    ws['G2'] = 'Total Price'
    ws['G2'].font = openpyxl.styles.Font(b=True, color='000000', size=12)


## 칼럼별 너비 조정 구간
#    for col in range(ws.max_column):
#        ws.column_dimensions[chr(ord('A') + col)].width = 15
    ws.column_dimensions['A'].width = 15
    ws.column_dimensions['B'].width = 45
    ws.column_dimensions['C'].width = 60
    ws.column_dimensions['D'].width = 20
    ws.column_dimensions['E'].width = 20
    ws.column_dimensions['F'].width = 20
    ws.column_dimensions['G'].width = 20
    #ws.column_dimensions['G'].width = 9
    #ws.column_dimensions['H'].width = 9
    #ws.column_dimensions['H'].hidden = True
    #ws.column_dimensions['I'].width = 12
    #ws.column_dimensions['I'].hidden = True
    #ws.column_dimensions['J'].width = 12
    #ws.column_dimensions['K'].width = 12
    #ws.column_dimensions['L'].width = 12

###
    start_row = 3
    for (row, item) in enumerate(sample_items, start_row):
        cell = ws.cell(row=row, column=1, value=row - 2)
        cell.alignment = openpyxl.styles.Alignment(horizontal='center', vertical='center')

#        cell = ws.cell(row=row, column=2, value=item[0])
#        cell.number_format = openpyxl.styles.numbers.FORMAT_DATE_YYYYMMDD2  # 'yyyy-mm-dd'
        ws.cell(row=row, column=2, value=item[0]) ## Family Type 칼럼

        ws.cell(row=row, column=3, value=item[1]) ## WorkMaster Code 칼럼
        
        ws.cell(row=row, column=4, value=item[2]) ## Quantities 칼럼
        
        ws.cell(row=row, column=5, value=item[3]) ## Unit 칼럼
        
        #cell = ws.cell(row=row, column=8, value=item[6]) ## 계수 칼럼
        #cell.number_format = openpyxl.styles.numbers.builtin_format_code(3)  # '#,##0'
        
        #cell = ws.cell(row=row, column=9, value=item[7]) ## 계산 참조값 칼럼
        #cell.number_format = openpyxl.styles.numbers.builtin_format_code(3)  # '#,##0'
        
        #cell = ws.cell(row=row, column=10, value=item[8]) ## Quantities 칼럼
        #cell.number_format = openpyxl.styles.numbers.builtin_format_code(3)  # '#,##0'
        #cell.font = openpyxl.styles.Font(b=True, color='000000', size=11)

        cell = ws.cell(row=row, column=7, value='= D{current_row}*F{current_row}'.format(current_row=cell.row))
        cell.number_format = '#,##0'

#        cell = ws.cell(row=row, column=6, value='= D{current_row} * E{current_row}'.format(current_row=cell.row))
#        cell.number_format = openpyxl.styles.numbers.builtin_format_code(3)

    total_row = ws.max_row + 1
    if total_row > start_row:
        cell1 = ws.cell(row=total_row, column=6, value='Total')
        cell1.font = openpyxl.styles.Font(b=True, color='000000', size=15)
        
        cell2 = ws.cell(row=total_row, column=7, value='= SUM(G{}:G{})'.format(start_row, total_row - 1))
        cell2.number_format = openpyxl.styles.numbers.builtin_format_code(3)
        cell2.border = Border(top=double, left=double, right=double, bottom=double)
        cell2.font = openpyxl.styles.Font(b=True, color='ff03ce', size=15)
    

    wb.save(filepath)
    wb.close()


##if __name__ == '__main__':
#write_to_file('C:\\Users\\pjmk0\\AppData\\Roaming\\test.xlsx')

save_name = "HecStrFDNCalcSheet_" + Today.strftime("%Y-%m-%d")+".xlsx"
path = os.getenv('APPDATA').replace('\\','\\\\')
filePath = path + '\\' + save_name

write_to_file(filePath)

# Assign your output to the OUT variable.
OUT = os.getenv('APPDATA')
# ----------------------------------------

# group: Select Target Family Element And Connected WorkMasters
code_block_236 = CodeBlock { 0; }
selectTargetFamilyInformAsDictionary_3 = Custom[SelectTargetFamilyInformAsDictionary](InputIndex=code_block_236)  # unwired: InputDic

watch_20 = Watch(selectTargetFamilyInformAsDictionary_3)
code_block_237 = CodeBlock(i=watch_20) { i; }
code_block_238 = CodeBlock { "TargetElements"; }
valueAtKey_48 = DesignScript.Builtin.Dictionary.ValueAtKey(dictionary=code_block_237, key=code_block_238)
extractUpperFacesOfElement_4 = Custom[ExtractUpperFacesOfElement](Element=valueAtKey_48)
code_block_239 = CodeBlock(SeeResult=extractUpperFacesOfElement_4.GeometryColor) { SeeResult; }
area_13 = Surface.Area(surface=extractUpperFacesOfElement_4.Surface)
sum_7 = Math.Sum(values=area_13)
code_block_240 = CodeBlock(i=sum_7) { Math.Round(List.Flatten(i)/1000000, 2); }
code_block_241 = CodeBlock { "M3"; }
count_43 = List.Count(list=code_block_240)
ofRepeatedItem_37 = List.OfRepeatedItem(item=code_block_241, amount=count_43)
code_block_242 = CodeBlock(FuncValues=code_block_240, FuncValuesUnit=ofRepeatedItem_37)  # same code as code_block_50
join_5 = List.Join(list0=code_block_242)

# group: TargetWMunique + Data Sending
code_block_243 = CodeBlock(InputDic2=join_5) { _InputDic2; }
count_44 = List.Count(list=code_block_243)
code_block_244 = CodeBlock(InputDic1=code_block_237) { _InputDic1; }
code_block_245 = CodeBlock { "TargetWMunique"; }
valueAtKey_49 = DesignScript.Builtin.Dictionary.ValueAtKey(dictionary=code_block_244, key=code_block_245)
watch_21 = Watch(valueAtKey_49)
count_45 = List.Count(list=watch_21)
eq_4 = count_44 == count_45
organizeFuncValuesAndWorkMasterAsDiction_4 = Custom[OrganizeFuncValuesAndWorkMasterAsDictionary](InputDic1=code_block_244, InputDic2=code_block_243)
watch_22 = Watch()  # unwired: arg0
if_7 = If(test=eq_4, true=organizeFuncValuesAndWorkMasterAsDiction_4, false=watch_22)

# group: 데이터 취합 및 Row 방향 정렬
code_block_246 = CodeBlock(InputDic=if_7) { _InputDic; }
code_block_247 = CodeBlock { "TrTargetFamilyCode"; }
valueAtKey_50 = DesignScript.Builtin.Dictionary.ValueAtKey(dictionary=code_block_246, key=code_block_247)
watch_23 = Watch(valueAtKey_50)
flatten_17 = List.Flatten(list=watch_23)
code_block_248 = CodeBlock { "WMforTargetElements"; }
valueAtKey_51 = DesignScript.Builtin.Dictionary.ValueAtKey(dictionary=code_block_246, key=code_block_248)
watch_24 = Watch(valueAtKey_51)
flatten_18 = List.Flatten(list=watch_24)
code_block_249 = CodeBlock { "TargetFuncValues"; }
valueAtKey_52 = DesignScript.Builtin.Dictionary.ValueAtKey(dictionary=code_block_246, key=code_block_249)
watch_25 = Watch(valueAtKey_52)
flatten_19 = List.Flatten(list=watch_25)
code_block_250 = CodeBlock { "TargetFuncValuesUnit"; }
valueAtKey_53 = DesignScript.Builtin.Dictionary.ValueAtKey(dictionary=code_block_246, key=code_block_250)
watch_26 = Watch(valueAtKey_53)
flatten_20 = List.Flatten(list=watch_26)
list_create_4 = List.Create(item0=flatten_17, item1=flatten_18, item2=flatten_19, item3=flatten_20)
transpose_4 = List.Transpose(lists=list_create_4)

# group: 패밀리 별 취합 + Export Excel(By OpenpyXl)
# note: Excel Export Button
boolean_2 = BoolSelector(true)
join_6 = List.Join(list0=transpose_4)
watch_27 = Watch()  # unwired: arg0
if_8 = If(test=boolean_2, true=join_6, false=watch_27)
python_script_export_excel_by_2 = Python(IN[0]=if_8)  # "Python Script@Export Excel(By OpenpyXl)"; CPython3; same code as python_script_export_excel_by

# group: Primary Input
categories_2 = Categories("OST_Gutter")
all_elements_of_category_2 = ElementsOfCategory(Category=categories_2)
file_path_2 = Filename(".\BIM_물량집계 자동화 산출기준표_rC(20210729).xlsx")
file_from_path_2 = FileObject(path=file_path_2)
code_block_251 = CodeBlock { "Gutters"; }

# group: GetFull WMCodeDescription PerElement
getFullWMCodeDescriptionPerElement_2 = Custom[GetFullWMCodeDescriptionPerElement](InputElement=all_elements_of_category_2, InputFilePath=file_from_path_2, InputSheetName=code_block_251)

# group: OrganizeAllElementInformAsDictionary
organizeAllElementInformAsDictionary_2 = Custom[OrganizeAllElementInformAsDictionary](InputDic=getFullWMCodeDescriptionPerElement_2.Dictionary)

# group: Select Target Family Element And Connected WorkMasters
code_block_252 = CodeBlock { 0; }
selectTargetFamilyInformAsDictionary_4 = Custom[SelectTargetFamilyInformAsDictionary](InputIndex=code_block_252)  # unwired: InputDic

watch_28 = Watch(selectTargetFamilyInformAsDictionary_4)
code_block_253 = CodeBlock(i=watch_28) { i; }
code_block_254 = CodeBlock { "TargetElements"; }
valueAtKey_54 = DesignScript.Builtin.Dictionary.ValueAtKey(dictionary=code_block_253, key=code_block_254)
code_block_255 = CodeBlock { "Length"; }
getParameterValueByName_7 = Element.GetParameterValueByName(element=valueAtKey_54, parameterName=code_block_255)
code_block_256 = CodeBlock { 1; }
mul_6 = getParameterValueByName_7 * code_block_256
code_block_257 = CodeBlock(i=mul_6) { Math.Round(List.Flatten(i)/1, 2); }
code_block_258 = CodeBlock { "TON"; }
count_46 = List.Count(list=code_block_257)
ofRepeatedItem_38 = List.OfRepeatedItem(item=code_block_258, amount=count_46)
code_block_259 = CodeBlock(FuncValues=code_block_257, FuncValuesUnit=ofRepeatedItem_38)  # same code as code_block_50
join_7 = List.Join(list0=code_block_259)

# group: TargetWMunique + Data Sending
code_block_260 = CodeBlock(InputDic2=join_7) { _InputDic2; }
count_47 = List.Count(list=code_block_260)
code_block_261 = CodeBlock(InputDic1=code_block_253) { _InputDic1; }
code_block_262 = CodeBlock { "TargetWMunique"; }
valueAtKey_55 = DesignScript.Builtin.Dictionary.ValueAtKey(dictionary=code_block_261, key=code_block_262)
watch_29 = Watch(valueAtKey_55)
count_48 = List.Count(list=watch_29)
eq_5 = count_47 == count_48
organizeFuncValuesAndWorkMasterAsDiction_5 = Custom[OrganizeFuncValuesAndWorkMasterAsDictionary](InputDic1=code_block_261, InputDic2=code_block_260)
watch_30 = Watch()  # unwired: arg0
if_9 = If(test=eq_5, true=organizeFuncValuesAndWorkMasterAsDiction_5, false=watch_30)

# group: 데이터 취합 및 Row 방향 정렬
code_block_263 = CodeBlock(InputDic=if_9) { _InputDic; }
code_block_264 = CodeBlock { "TrTargetFamilyCode"; }
valueAtKey_56 = DesignScript.Builtin.Dictionary.ValueAtKey(dictionary=code_block_263, key=code_block_264)
watch_31 = Watch(valueAtKey_56)
flatten_21 = List.Flatten(list=watch_31)
code_block_265 = CodeBlock { "WMforTargetElements"; }
valueAtKey_57 = DesignScript.Builtin.Dictionary.ValueAtKey(dictionary=code_block_263, key=code_block_265)
watch_32 = Watch(valueAtKey_57)
flatten_22 = List.Flatten(list=watch_32)
code_block_266 = CodeBlock { "TargetFuncValues"; }
valueAtKey_58 = DesignScript.Builtin.Dictionary.ValueAtKey(dictionary=code_block_263, key=code_block_266)
watch_33 = Watch(valueAtKey_58)
flatten_23 = List.Flatten(list=watch_33)
code_block_267 = CodeBlock { "TargetFuncValuesUnit"; }
valueAtKey_59 = DesignScript.Builtin.Dictionary.ValueAtKey(dictionary=code_block_263, key=code_block_267)
watch_34 = Watch(valueAtKey_59)
flatten_24 = List.Flatten(list=watch_34)
list_create_5 = List.Create(item0=flatten_21, item1=flatten_22, item2=flatten_23, item3=flatten_24)
transpose_5 = List.Transpose(lists=list_create_5)

# group: 패밀리 별 취합 + Export Excel(By OpenpyXl)
# note: Excel Export Button
boolean_3 = BoolSelector(true)
join_8 = List.Join(list0=transpose_5)
watch_35 = Watch()  # unwired: arg0
if_10 = If(test=boolean_3, true=join_8, false=watch_35)
python_script_export_excel_by_3 = Python(IN[0]=if_10)  # "Python Script@Export Excel(By OpenpyXl)"; CPython3; same code as python_script_export_excel_by

# group: Select Target Family Element And Connected WorkMasters
code_block_268 = CodeBlock { 0; }
selectTargetFamilyInformAsDictionary_5 = Custom[SelectTargetFamilyInformAsDictionary](InputIndex=code_block_268)  # unwired: InputDic

watch_36 = Watch(selectTargetFamilyInformAsDictionary_5)
code_block_269 = CodeBlock(i=watch_36) { i; }
code_block_270 = CodeBlock { "TargetElements"; }
valueAtKey_60 = DesignScript.Builtin.Dictionary.ValueAtKey(dictionary=code_block_269, key=code_block_270)
code_block_271 = CodeBlock { "Area"; }
getParameterValueByName_8 = Element.GetParameterValueByName(element=valueAtKey_60, parameterName=code_block_271)
code_block_272 = CodeBlock { 1; }
mul_7 = getParameterValueByName_8 * code_block_272
code_block_273 = CodeBlock(i=mul_7) { Math.Round(List.Flatten(i)/1, 2); }
code_block_274 = CodeBlock { "M2"; }
count_49 = List.Count(list=code_block_273)
ofRepeatedItem_39 = List.OfRepeatedItem(item=code_block_274, amount=count_49)
code_block_275 = CodeBlock(FuncValues=code_block_273, FuncValuesUnit=ofRepeatedItem_39)  # same code as code_block_50
join_9 = List.Join(list0=code_block_275)

# group: TargetWMunique + Data Sending
code_block_276 = CodeBlock(InputDic2=join_9) { _InputDic2; }
count_50 = List.Count(list=code_block_276)
code_block_277 = CodeBlock(InputDic1=code_block_269) { _InputDic1; }
code_block_278 = CodeBlock { "TargetWMunique"; }
valueAtKey_61 = DesignScript.Builtin.Dictionary.ValueAtKey(dictionary=code_block_277, key=code_block_278)
watch_37 = Watch(valueAtKey_61)
count_51 = List.Count(list=watch_37)
eq_6 = count_50 == count_51
organizeFuncValuesAndWorkMasterAsDiction_6 = Custom[OrganizeFuncValuesAndWorkMasterAsDictionary](InputDic1=code_block_277, InputDic2=code_block_276)
watch_38 = Watch()  # unwired: arg0
if_11 = If(test=eq_6, true=organizeFuncValuesAndWorkMasterAsDiction_6, false=watch_38)

# group: 데이터 취합 및 Row 방향 정렬
code_block_279 = CodeBlock(InputDic=if_11) { _InputDic; }
code_block_280 = CodeBlock { "TrTargetFamilyCode"; }
valueAtKey_62 = DesignScript.Builtin.Dictionary.ValueAtKey(dictionary=code_block_279, key=code_block_280)
watch_39 = Watch(valueAtKey_62)
flatten_25 = List.Flatten(list=watch_39)
code_block_281 = CodeBlock { "WMforTargetElements"; }
valueAtKey_63 = DesignScript.Builtin.Dictionary.ValueAtKey(dictionary=code_block_279, key=code_block_281)
watch_40 = Watch(valueAtKey_63)
flatten_26 = List.Flatten(list=watch_40)
code_block_282 = CodeBlock { "TargetFuncValues"; }
valueAtKey_64 = DesignScript.Builtin.Dictionary.ValueAtKey(dictionary=code_block_279, key=code_block_282)
watch_41 = Watch(valueAtKey_64)
flatten_27 = List.Flatten(list=watch_41)
code_block_283 = CodeBlock { "TargetFuncValuesUnit"; }
valueAtKey_65 = DesignScript.Builtin.Dictionary.ValueAtKey(dictionary=code_block_279, key=code_block_283)
watch_42 = Watch(valueAtKey_65)
flatten_28 = List.Flatten(list=watch_42)
list_create_6 = List.Create(item0=flatten_25, item1=flatten_26, item2=flatten_27, item3=flatten_28)
transpose_6 = List.Transpose(lists=list_create_6)

# group: 패밀리 별 취합 + Export Excel(By OpenpyXl)
# note: Excel Export Button
boolean_4 = BoolSelector(true)
join_10 = List.Join(list0=transpose_6)
watch_43 = Watch()  # unwired: arg0
if_12 = If(test=boolean_4, true=join_10, false=watch_43)
python_script_export_excel_by_4 = Python(IN[0]=if_12)  # "Python Script@Export Excel(By OpenpyXl)"; CPython3; same code as python_script_export_excel_by

# group: Primary Input
categories_3 = Categories("OST_Ceilings")
all_elements_of_category_3 = ElementsOfCategory(Category=categories_3)
file_path_3 = Filename(".\BIM_물량집계 자동화 산출기준표_rC(20210729).xlsx")
file_from_path_3 = FileObject(path=file_path_3)
code_block_284 = CodeBlock { "Ceiling"; }

# group: GetFull WMCodeDescription PerElement
getFullWMCodeDescriptionPerElement_3 = Custom[GetFullWMCodeDescriptionPerElement](InputElement=all_elements_of_category_3, InputFilePath=file_from_path_3, InputSheetName=code_block_284)

# group: OrganizeAllElementInformAsDictionary
organizeAllElementInformAsDictionary_3 = Custom[OrganizeAllElementInformAsDictionary](InputDic=getFullWMCodeDescriptionPerElement_3.Dictionary)

# group: Select Target Family Element And Connected WorkMasters
code_block_285 = CodeBlock { 1; }
selectTargetFamilyInformAsDictionary_6 = Custom[SelectTargetFamilyInformAsDictionary](InputIndex=code_block_285)  # unwired: InputDic

list_create_7 = List.Create(item0=selectTargetFamilyInformAsDictionary_5, item1=selectTargetFamilyInformAsDictionary_6)

# group: Primary Input
categories_4 = Categories("OST_Doors")
all_elements_of_category_4 = ElementsOfCategory(Category=categories_4)
file_path_4 = Filename(".\BIM_물량집계 자동화 산출기준표_rC(20210729).xlsx")
file_from_path_4 = FileObject(path=file_path_4)
code_block_286 = CodeBlock { "Doors"; }

# group: GetFull WMCodeDescription PerElement
getFullWMCodeDescriptionPerElement_4 = Custom[GetFullWMCodeDescriptionPerElement](InputElement=all_elements_of_category_4, InputFilePath=file_from_path_4, InputSheetName=code_block_286)

# group: OrganizeAllElementInformAsDictionary
organizeAllElementInformAsDictionary_4 = Custom[OrganizeAllElementInformAsDictionary](InputDic=getFullWMCodeDescriptionPerElement_4.Dictionary)

# group: Select Target Family Element And Connected WorkMasters
code_block_287 = CodeBlock { 0; }
selectTargetFamilyInformAsDictionary_7 = Custom[SelectTargetFamilyInformAsDictionary](InputDic=organizeAllElementInformAsDictionary_4, InputIndex=code_block_287)

watch_44 = Watch(selectTargetFamilyInformAsDictionary_7)
code_block_288 = CodeBlock(i=watch_44) { i; }

# group: <Func X> Count
code_block_289 = CodeBlock { "TargetElements"; }
valueAtKey_66 = DesignScript.Builtin.Dictionary.ValueAtKey(dictionary=code_block_288, key=code_block_289)
count_52 = List.Count(list=valueAtKey_66@L2)
code_block_290 = CodeBlock { "EA"; }

count_53 = List.Count(list=count_52)

# group (continued): <Func X> Count
ofRepeatedItem_40 = List.OfRepeatedItem(item=code_block_290, amount=count_53)
code_block_291 = CodeBlock(FuncValues=count_52, FuncValuesUnit=ofRepeatedItem_40)  # same code as code_block_50

join_11 = List.Join(list0=code_block_291)

# group: TargetWMunique + Data Sending
code_block_292 = CodeBlock(InputDic2=join_11) { _InputDic2; }
count_54 = List.Count(list=code_block_292)
code_block_293 = CodeBlock(InputDic1=code_block_288) { _InputDic1; }
code_block_294 = CodeBlock { "TargetWMunique"; }
valueAtKey_67 = DesignScript.Builtin.Dictionary.ValueAtKey(dictionary=code_block_293, key=code_block_294)
watch_45 = Watch(valueAtKey_67)
count_55 = List.Count(list=watch_45)
eq_7 = count_54 == count_55
organizeFuncValuesAndWorkMasterAsDiction_7 = Custom[OrganizeFuncValuesAndWorkMasterAsDictionary](InputDic1=code_block_293, InputDic2=code_block_292)
watch_46 = Watch()  # unwired: arg0
if_13 = If(test=eq_7, true=organizeFuncValuesAndWorkMasterAsDiction_7, false=watch_46)

# group: 데이터 취합 및 Row 방향 정렬
code_block_295 = CodeBlock(InputDic=if_13) { _InputDic; }
code_block_296 = CodeBlock { "TrTargetFamilyCode"; }
valueAtKey_68 = DesignScript.Builtin.Dictionary.ValueAtKey(dictionary=code_block_295, key=code_block_296)
watch_47 = Watch(valueAtKey_68)
flatten_29 = List.Flatten(list=watch_47)
code_block_297 = CodeBlock { "WMforTargetElements"; }
valueAtKey_69 = DesignScript.Builtin.Dictionary.ValueAtKey(dictionary=code_block_295, key=code_block_297)
watch_48 = Watch(valueAtKey_69)
flatten_30 = List.Flatten(list=watch_48)
code_block_298 = CodeBlock { "TargetFuncValues"; }
valueAtKey_70 = DesignScript.Builtin.Dictionary.ValueAtKey(dictionary=code_block_295, key=code_block_298)
watch_49 = Watch(valueAtKey_70)
flatten_31 = List.Flatten(list=watch_49)
code_block_299 = CodeBlock { "TargetFuncValuesUnit"; }
valueAtKey_71 = DesignScript.Builtin.Dictionary.ValueAtKey(dictionary=code_block_295, key=code_block_299)
watch_50 = Watch(valueAtKey_71)
flatten_32 = List.Flatten(list=watch_50)
list_create_8 = List.Create(item0=flatten_29, item1=flatten_30, item2=flatten_31, item3=flatten_32)
transpose_7 = List.Transpose(lists=list_create_8)

# group: 패밀리 별 취합 + Export Excel(By OpenpyXl)
# note: Excel Export Button
boolean_5 = BoolSelector(true)
join_12 = List.Join(list0=transpose_7)
watch_51 = Watch()  # unwired: arg0
if_14 = If(test=boolean_5, true=join_12, false=watch_51)
python_script_export_excel_by_5 = Python(IN[0]=if_14)  # "Python Script@Export Excel(By OpenpyXl)"; CPython3; same code as python_script_export_excel_by

# group: Select Target Family Element And Connected WorkMasters
code_block_300 = CodeBlock { 1; }
selectTargetFamilyInformAsDictionary_8 = Custom[SelectTargetFamilyInformAsDictionary](InputDic=organizeAllElementInformAsDictionary_4, InputIndex=code_block_300)

list_create_9 = List.Create(item0=selectTargetFamilyInformAsDictionary_7, item1=selectTargetFamilyInformAsDictionary_8)

# group: DATA 확인
code_block_301 = CodeBlock {  }
code_block_302 = CodeBlock {  }

# group: DATA 확인
code_block_303 = CodeBlock {  }
code_block_304 = CodeBlock {  }

# group: Primary Input
categories_5 = Categories("OST_Windows")
all_elements_of_category_5 = ElementsOfCategory(Category=categories_5)
file_path_5 = Filename(".\BIM_물량집계 자동화 산출기준표_rC(20210729).xlsx")
file_from_path_5 = FileObject(path=file_path_5)
code_block_305 = CodeBlock { "Windows"; }

string_from_object = FromObject(object=all_elements_of_category_5)
code_block_306 = CodeBlock { "WD"; }
contains = String.Contains(str=string_from_object, searchFor=code_block_306)
watch_52 = Watch(contains)
filterByBoolMask = List.FilterByBoolMask(list=all_elements_of_category_5, mask=watch_52)
watch_53 = Watch(filterByBoolMask.in)

# group: GetFull WMCodeDescription PerElement
getFullWMCodeDescriptionPerElement_5 = Custom[GetFullWMCodeDescriptionPerElement](InputElement=watch_53, InputFilePath=file_from_path_5, InputSheetName=code_block_305)

# group: OrganizeAllElementInformAsDictionary
organizeAllElementInformAsDictionary_5 = Custom[OrganizeAllElementInformAsDictionary](InputDic=getFullWMCodeDescriptionPerElement_5.Dictionary)

# group: Select Target Family Element And Connected WorkMasters
code_block_307 = CodeBlock { 0; }
selectTargetFamilyInformAsDictionary_9 = Custom[SelectTargetFamilyInformAsDictionary](InputDic=organizeAllElementInformAsDictionary_5, InputIndex=code_block_307)

# group: Select Target Family Element And Connected WorkMasters
code_block_308 = CodeBlock { 1; }
selectTargetFamilyInformAsDictionary_10 = Custom[SelectTargetFamilyInformAsDictionary](InputDic=organizeAllElementInformAsDictionary_5, InputIndex=code_block_308)

list_create_10 = List.Create(item0=selectTargetFamilyInformAsDictionary_9, item1=selectTargetFamilyInformAsDictionary_10)
watch_54 = Watch(selectTargetFamilyInformAsDictionary_9)
code_block_309 = CodeBlock(i=watch_54) { i; }

# group: <Func X> Count
code_block_310 = CodeBlock { "TargetElements"; }
valueAtKey_72 = DesignScript.Builtin.Dictionary.ValueAtKey(dictionary=code_block_309, key=code_block_310)
code_block_311 = CodeBlock { "EA"; }

name = Element.Name()  # unwired: element
groupByFunction = List.GroupByFunction(list=valueAtKey_72@L2, groupFunction=name)
watch_55 = Watch(groupByFunction)
flatten_33 = List.Flatten(list=watch_55@L2)

# group (continued): <Func X> Count
count_56 = List.Count(list=flatten_33@L2)

count_57 = List.Count(list=count_56)

# group (continued): <Func X> Count
ofRepeatedItem_41 = List.OfRepeatedItem(item=code_block_311, amount=count_57)
code_block_312 = CodeBlock(FuncValues=count_56, FuncValuesUnit=ofRepeatedItem_41)  # same code as code_block_50

join_13 = List.Join(list0=code_block_312)

# group: TargetWMunique + Data Sending
code_block_313 = CodeBlock(InputDic2=join_13) { _InputDic2; }
count_58 = List.Count(list=code_block_313)
code_block_314 = CodeBlock(InputDic1=code_block_309) { _InputDic1; }
code_block_315 = CodeBlock { "TargetWMunique"; }
valueAtKey_73 = DesignScript.Builtin.Dictionary.ValueAtKey(dictionary=code_block_314, key=code_block_315)
watch_56 = Watch(valueAtKey_73)
count_59 = List.Count(list=watch_56)
eq_8 = count_58 == count_59
organizeFuncValuesAndWorkMasterAsDiction_8 = Custom[OrganizeFuncValuesAndWorkMasterAsDictionary](InputDic1=code_block_314, InputDic2=code_block_313)
watch_57 = Watch()  # unwired: arg0
if_15 = If(test=eq_8, true=organizeFuncValuesAndWorkMasterAsDiction_8, false=watch_57)

# group: 데이터 취합 및 Row 방향 정렬
code_block_316 = CodeBlock(InputDic=if_15) { _InputDic; }
code_block_317 = CodeBlock { "TrTargetFamilyCode"; }
valueAtKey_74 = DesignScript.Builtin.Dictionary.ValueAtKey(dictionary=code_block_316, key=code_block_317)
watch_58 = Watch(valueAtKey_74)
flatten_34 = List.Flatten(list=watch_58)
code_block_318 = CodeBlock { "WMforTargetElements"; }
valueAtKey_75 = DesignScript.Builtin.Dictionary.ValueAtKey(dictionary=code_block_316, key=code_block_318)
watch_59 = Watch(valueAtKey_75)
flatten_35 = List.Flatten(list=watch_59)
code_block_319 = CodeBlock { "TargetFuncValues"; }
valueAtKey_76 = DesignScript.Builtin.Dictionary.ValueAtKey(dictionary=code_block_316, key=code_block_319)
watch_60 = Watch(valueAtKey_76)
flatten_36 = List.Flatten(list=watch_60)
code_block_320 = CodeBlock { "TargetFuncValuesUnit"; }
valueAtKey_77 = DesignScript.Builtin.Dictionary.ValueAtKey(dictionary=code_block_316, key=code_block_320)
watch_61 = Watch(valueAtKey_77)
flatten_37 = List.Flatten(list=watch_61)
list_create_11 = List.Create(item0=flatten_34, item1=flatten_35, item2=flatten_36, item3=flatten_37)
transpose_8 = List.Transpose(lists=list_create_11)

# group: 패밀리 별 취합 + Export Excel(By OpenpyXl)
# note: Excel Export Button
boolean_6 = BoolSelector(true)
join_14 = List.Join(list0=transpose_8)
watch_62 = Watch()  # unwired: arg0
if_16 = If(test=boolean_6, true=join_14, false=watch_62)
python_script_export_excel_by_6 = Python(IN[0]=if_16)  # "Python Script@Export Excel(By OpenpyXl)"; CPython3; same code as python_script_export_excel_by

join_15 = List.Join()  # unwired: list0

# group: Primary Input
categories_6 = Categories("OST_Stairs")
all_elements_of_category_6 = ElementsOfCategory(Category=categories_6)
file_path_6 = Filename(".\BIM_물량집계 자동화 산출기준표_rC(20210729).xlsx")
file_from_path_6 = FileObject(path=file_path_6)
code_block_321 = CodeBlock { "Doors"; }

# group: GetFull WMCodeDescription PerElement
getFullWMCodeDescriptionPerElement_6 = Custom[GetFullWMCodeDescriptionPerElement](InputElement=all_elements_of_category_6, InputFilePath=file_from_path_6, InputSheetName=code_block_321)

# group: OrganizeAllElementInformAsDictionary
organizeAllElementInformAsDictionary_6 = Custom[OrganizeAllElementInformAsDictionary](InputDic=getFullWMCodeDescriptionPerElement_6.Dictionary)

# group: Select Target Family Element And Connected WorkMasters
code_block_322 = CodeBlock { 0; }
selectTargetFamilyInformAsDictionary_11 = Custom[SelectTargetFamilyInformAsDictionary](InputDic=organizeAllElementInformAsDictionary_6, InputIndex=code_block_322)

watch_63 = Watch(selectTargetFamilyInformAsDictionary_11)
code_block_323 = CodeBlock(i=watch_63) { i; }

# group: TargetWMunique + Data Sending
code_block_324 = CodeBlock(InputDic2=join_15) { _InputDic2; }
count_60 = List.Count(list=code_block_324)
code_block_325 = CodeBlock(InputDic1=code_block_323) { _InputDic1; }
code_block_326 = CodeBlock { "TargetWMunique"; }
valueAtKey_78 = DesignScript.Builtin.Dictionary.ValueAtKey(dictionary=code_block_325, key=code_block_326)
watch_64 = Watch(valueAtKey_78)
count_61 = List.Count(list=watch_64)
eq_9 = count_60 == count_61
organizeFuncValuesAndWorkMasterAsDiction_9 = Custom[OrganizeFuncValuesAndWorkMasterAsDictionary](InputDic1=code_block_325, InputDic2=code_block_324)
watch_65 = Watch()  # unwired: arg0
if_17 = If(test=eq_9, true=organizeFuncValuesAndWorkMasterAsDiction_9, false=watch_65)

# group: 데이터 취합 및 Row 방향 정렬
code_block_327 = CodeBlock(InputDic=if_17) { _InputDic; }
code_block_328 = CodeBlock { "TrTargetFamilyCode"; }
valueAtKey_79 = DesignScript.Builtin.Dictionary.ValueAtKey(dictionary=code_block_327, key=code_block_328)
watch_66 = Watch(valueAtKey_79)
flatten_38 = List.Flatten(list=watch_66)
code_block_329 = CodeBlock { "WMforTargetElements"; }
valueAtKey_80 = DesignScript.Builtin.Dictionary.ValueAtKey(dictionary=code_block_327, key=code_block_329)
watch_67 = Watch(valueAtKey_80)
flatten_39 = List.Flatten(list=watch_67)
code_block_330 = CodeBlock { "TargetFuncValues"; }
valueAtKey_81 = DesignScript.Builtin.Dictionary.ValueAtKey(dictionary=code_block_327, key=code_block_330)
watch_68 = Watch(valueAtKey_81)
flatten_40 = List.Flatten(list=watch_68)
code_block_331 = CodeBlock { "TargetFuncValuesUnit"; }
valueAtKey_82 = DesignScript.Builtin.Dictionary.ValueAtKey(dictionary=code_block_327, key=code_block_331)
watch_69 = Watch(valueAtKey_82)
flatten_41 = List.Flatten(list=watch_69)
list_create_12 = List.Create(item0=flatten_38, item1=flatten_39, item2=flatten_40, item3=flatten_41)
transpose_9 = List.Transpose(lists=list_create_12)

# group: 패밀리 별 취합 + Export Excel(By OpenpyXl)
# note: Excel Export Button
boolean_7 = BoolSelector(true)
join_16 = List.Join(list0=transpose_9)
watch_70 = Watch()  # unwired: arg0
if_18 = If(test=boolean_7, true=join_16, false=watch_70)
python_script_export_excel_by_7 = Python(IN[0]=if_18)  # "Python Script@Export Excel(By OpenpyXl)"; CPython3; same code as python_script_export_excel_by

# group: <Func 2> 하부/측면/Riser 면적산출
code_block_332 = CodeBlock { "TargetElements"; }
valueAtKey_83 = DesignScript.Builtin.Dictionary.ValueAtKey(dictionary=code_block_323, key=code_block_332)
# note: <Func>
extractSideFacesOfElement_5 = Custom[ExtractSideFacesOfElement](Element=valueAtKey_83)
area_14 = Surface.Area(surface=extractSideFacesOfElement_5.Surface)
sum_8 = Math.Sum(values=area_14)
code_block_333 = CodeBlock(i=sum_8) { Math.Round(List.Flatten(i)/1000000, 2); }
code_block_334 = CodeBlock { "M2"; }
count_62 = List.Count(list=code_block_333)
ofRepeatedItem_42 = List.OfRepeatedItem(item=code_block_334, amount=count_62)
code_block_335 = CodeBlock(FuncValues=code_block_333, FuncValuesUnit=ofRepeatedItem_42)  # same code as code_block_50

# group: <Func 1> 콘크리트 체적
code_block_336 = CodeBlock { "TargetElements"; }
# note: <Func>
valueAtKey_84 = DesignScript.Builtin.Dictionary.ValueAtKey(dictionary=code_block_323, key=code_block_336)
code_block_337 = CodeBlock { "M3"; }

geometry = Element.Geometry(element=valueAtKey_84)
flatten_42 = List.Flatten(list=geometry@L2)

# group (continued): <Func 1> 콘크리트 체적
volume_7 = Solid.Volume(solid=flatten_42)

flatten_43 = List.Flatten(list=volume_7)
sum_9 = Math.Sum(values=flatten_43)

# group (continued): <Func 1> 콘크리트 체적
code_block_338 = CodeBlock(i=sum_9) { Math.Round(List.Flatten(i)/1000000000, 2); }
count_63 = List.Count(list=code_block_338)
ofRepeatedItem_43 = List.OfRepeatedItem(item=code_block_337, amount=count_63)
code_block_339 = CodeBlock(FuncValues=code_block_338, FuncValuesUnit=ofRepeatedItem_43)  # same code as code_block_50

extractBelowFacesOfElement_2 = Custom[ExtractBelowFacesOfElement](Element=valueAtKey_83)
