# Dynamo graph Generic Model (0909).dyn (Dynamo 2.10.1.3976)

# group: Primary Input
categories = Categories("OST_GenericModel")
all_elements_of_category = ElementsOfCategory(Category=categories)
file_path = Filename(".\BIM_물량집계 자동화 산출기준표_rC(20210729).xlsx")
file_from_path = FileObject(path=file_path)
code_block = CodeBlock { "Generic Models"; }

# group: GetFull WMCodeDescription PerElement
getFullWMCodeDescriptionPerElement = Custom[GetFullWMCodeDescriptionPerElement](InputElement=all_elements_of_category, InputFilePath=file_from_path, InputSheetName=code_block)  # GetFullWMCodeDescriptionPerElement

# group: OrganizeAllElementInformAsDictionary
organizeAllElementInformAsDictionary = Custom[OrganizeAllElementInformAsDictionary](InputDic=getFullWMCodeDescriptionPerElement.Dictionary)  # OrganizeAllElementInformAsDictionary

# group: Select Target Family Element And Connected WorkMasters
code_block_2 = CodeBlock { 0..4; }
selectTargetFamilyInformAsDictionary = Custom[SelectTargetFamilyInformAsDictionary](InputDic=organizeAllElementInformAsDictionary, InputIndex=code_block_2)  # Select Target Family Element And Connected WorkMasters

watch = Watch(selectTargetFamilyInformAsDictionary)

# group: <Func 2> 측면 면적산출
code_block_3 = CodeBlock { "TargetElements"; }
valueAtKey = DesignScript.Builtin.Dictionary.ValueAtKey(dictionary=watch, key=code_block_3)
# note: <Func>
extractSideFacesOfElement = Custom[ExtractSideFacesOfElement](Element=valueAtKey)  # ExtractSideFacesOfElement
geometry = Element.Geometry(element=valueAtKey)

extractUpperFacesOfElement = Custom[ExtractUpperFacesOfElement](Element=valueAtKey)  # ExtractUpperFacesOfElement
flatten = List.Flatten(list=valueAtKey)
elementType = Element.ElementType(element=flatten)
familyName = ElementType.FamilyName(elementType=elementType)
code_block_4 = CodeBlock { "ladder"; "Downpipe"; "sink"; }
contains = String.Contains(str=familyName, searchFor=code_block_4.out0, ignoreCase=code_block_4.out2)
filterByBoolMask = List.FilterByBoolMask(mask=contains)  # unwired: list
count = List.Count(list=filterByBoolMask.in@L2)
watch_2 = Watch(count)
contains_2 = String.Contains(str=familyName, searchFor=code_block_4.out0)
filterByBoolMask_2 = List.FilterByBoolMask(list=flatten, mask=contains_2)
code_block_5 = CodeBlock { "Ladder_Length"; }
getParameterValueByName = Element.GetParameterValueByName(element=filterByBoolMask_2.in, parameterName=code_block_5)
watch_3 = Watch(getParameterValueByName)
sum = Math.Sum(values=watch_3)
watch_4 = Watch(sum)
contains_3 = String.Contains(str=familyName, searchFor=code_block_4.out1)
filterByBoolMask_3 = List.FilterByBoolMask(list=flatten, mask=contains_3)
code_block_6 = CodeBlock { "Length_System"; }
getParameterValueByName_2 = Element.GetParameterValueByName(element=filterByBoolMask_3.in, parameterName=code_block_6)
watch_5 = Watch(getParameterValueByName_2)
round = Math.Round(number=watch_5)
sum_2 = Math.Sum(values=round)
watch_6 = Watch(sum_2)
