# Dynamo graph Room_DataStructureTest(0903).dyn (Dynamo 2.10.1.3976)

# group: Primary Input
categories = Categories("OST_Rooms")
all_elements_of_category = ElementsOfCategory(Category=categories)
file_path = Filename(".\BIM_물량집계 자동화 산출기준표_rC(20210729).xlsx")
file_from_path = FileObject(path=file_path)
code_block = CodeBlock { "Rooms"; }

# group: GetFull WMCodeDescription PerElement
getFullWMCodeDescriptionPerElement = Custom[GetFullWMCodeDescriptionPerElement](InputElement=all_elements_of_category, InputFilePath=file_from_path, InputSheetName=code_block)  # GetFullWMCodeDescriptionPerElement

# group: OrganizeAllElementInformAsDictionary
organizeAllElementInformAsDictionary = Custom[OrganizeAllElementInformAsDictionary](InputDic=getFullWMCodeDescriptionPerElement.Dictionary)  # OrganizeAllElementInformAsDictionary

watch = Watch(organizeAllElementInformAsDictionary)

# group: Select Target Family Element And Connected WorkMasters
code_block_2 = CodeBlock { 0; }
selectTargetFamilyInformAsDictionary = Custom[SelectTargetFamilyInformAsDictionary](InputDic=watch, InputIndex=code_block_2)  # Select Target Family Element And Connected WorkMasters

watch_2 = Watch(selectTargetFamilyInformAsDictionary)
code_block_3 = CodeBlock(i=watch_2) { i; }
code_block_4 = CodeBlock { "Element"; }
valueAtKey = DesignScript.Builtin.Dictionary.ValueAtKey(dictionary=watch, key=code_block_4)
extractUpperFacesOfElement = Custom[ExtractUpperFacesOfElement](Element=valueAtKey)  # ExtractUpperFacesOfElement
area = Surface.Area(surface=extractUpperFacesOfElement.Surface)
watch_3 = Watch(area)
extractSideFacesOfElement = Custom[ExtractSideFacesOfElement](Element=valueAtKey)  # ExtractSideFacesOfElement
area_2 = Surface.Area(surface=extractSideFacesOfElement.Surface)
watch_4 = Watch(area_2)
extractBelowFacesOfElement = Custom[ExtractBelowFacesOfElement](Element=valueAtKey)  # ExtractBelowFacesOfElement
area_3 = Surface.Area(surface=extractBelowFacesOfElement.Surface)
watch_5 = Watch(area_3)
finishBoundary = Room.FinishBoundary(room=valueAtKey)
length = Curve.Length(curve=finishBoundary)
sum = Math.Sum(values=length)
code_block_5 = CodeBlock { "Base Finish"; "Ceiling Finish"; "Wall Finish"; "Floor Finish"; }
list_create = List.Create(item0=code_block_5.out0, item1=code_block_5.out1, item2=code_block_5.out2, item3=code_block_5.out3)
getParameterValueByName = Element.GetParameterValueByName(element=valueAtKey, parameterName=list_create, lacing=CrossProduct)
watch_6 = Watch(getParameterValueByName)
code_block_6 = CodeBlock(a=finishBoundary) { a[1]; }
flatten = List.Flatten(list=code_block_6)
code_block_7 = CodeBlock { 2000; }
translate = Geometry.Translate(geometry=code_block_6, zTranslation=code_block_7)
flatten_2 = List.Flatten(list=translate)
list_create_2 = List.Create(item0=flatten, item1=flatten_2)
transpose = List.Transpose(lists=list_create_2@L3)
byLoft = Surface.ByLoft(crossSections=transpose)
area_4 = Surface.Area(surface=byLoft)
watch_7 = Watch(area_4)
