# Dynamo graph Slab Edge 측면, 하부 (0825).dyn (Dynamo 2.10.1.3976)

# group: Primary Input
categories = Categories("OST_EdgeSlab")
all_elements_of_category = ElementsOfCategory(Category=categories)
file_path = Filename(".\BIM_물량집계 자동화 산출기준표_rC(20210729).xlsx")
file_from_path = FileObject(path=file_path)
code_block = CodeBlock { "Slab Edges"; }

# group: GetFull WMCodeDescription PerElement
getFullWMCodeDescriptionPerElement = Custom[GetFullWMCodeDescriptionPerElement](InputElement=all_elements_of_category, InputFilePath=file_from_path, InputSheetName=code_block)  # GetFullWMCodeDescriptionPerElement

# group: OrganizeAllElementInformAsDictionary
organizeAllElementInformAsDictionary = Custom[OrganizeAllElementInformAsDictionary](InputDic=getFullWMCodeDescriptionPerElement.Dictionary)  # OrganizeAllElementInformAsDictionary

# group: Select Target Family Element And Connected WorkMasters
code_block_2 = CodeBlock { 0; }
selectTargetFamilyInformAsDictionary = Custom[SelectTargetFamilyInformAsDictionary](InputDic=organizeAllElementInformAsDictionary, InputIndex=code_block_2)  # Select Target Family Element And Connected WorkMasters

watch = Watch(selectTargetFamilyInformAsDictionary)
code_block_3 = CodeBlock(i=watch) { i; }

# group: <Func 2> 측면 면적산출
code_block_4 = CodeBlock { "TargetElements"; }
valueAtKey = DesignScript.Builtin.Dictionary.ValueAtKey(dictionary=code_block_3, key=code_block_4)
extractSideFacesOfElement = Custom[ExtractSideFacesOfElement](Element=valueAtKey)  # ExtractSideFacesOfElement
# note: <Func>
geometry = Element.Geometry(element=valueAtKey@L1)

watch_2 = Watch(extractSideFacesOfElement.Surface)
watch_3 = Watch(watch_2)
code_block_5 = CodeBlock { 1; }
flatten = List.Flatten(list=watch_3, amt=code_block_5)
code_block_6 = CodeBlock(a=flatten) { a[0]; }
explode = Geometry.Explode(geometry=code_block_6)
perimeterCurves = Surface.PerimeterCurves(surface=explode)
flatten_2 = List.Flatten(list=perimeterCurves)
length = Curve.Length(curve=flatten_2)
uniqueItems = List.UniqueItems(list=length)
watch_4 = Watch(uniqueItems)
sort = List.Sort(list=watch_4)
watch_5 = Watch(sort)
code_block_7 = CodeBlock(a=geometry) { a[0]; }
explode_2 = Geometry.Explode(geometry=code_block_7)
area = Surface.Area(surface=explode_2)
round = Math.Round(number=area)
uniqueItems_2 = List.UniqueItems(list=round)
code_block_8 = CodeBlock { 150000; }
gt = code_block_8 > round
filterByBoolMask = List.FilterByBoolMask(list=explode_2, mask=gt)
flatten_3 = List.Flatten(list=filterByBoolMask.in)
perimeterCurves_2 = Surface.PerimeterCurves(surface=flatten_3)
code_block_9 = CodeBlock { 0.5; }
pointAtParameter = Surface.PointAtParameter(surface=flatten_3, u=code_block_9, v=code_block_9)
startPoint = Curve.StartPoint(curve=perimeterCurves_2)
byStartPointEndPoint = Line.ByStartPointEndPoint(startPoint=pointAtParameter, endPoint=startPoint)
length_2 = Curve.Length()  # unwired: curve
minimumItemByKey = List.MinimumItemByKey(list=byStartPointEndPoint@L2, keyFunction=length_2)
doesIntersect = Geometry.DoesIntersect(geometry=minimumItemByKey, other=perimeterCurves_2)
filterByBoolMask_2 = List.FilterByBoolMask(list=perimeterCurves_2, mask=doesIntersect)
flatten_4 = List.Flatten(list=filterByBoolMask_2.in)
watch_6 = Watch(flatten_4)
code_block_10 = CodeBlock { 2; }
dropItems = List.DropItems(list=watch_6, amount=code_block_10)
endPoint = Curve.EndPoint(curve=dropItems)
code_block_11 = CodeBlock { -1; }
dropItems_2 = List.DropItems(list=endPoint, amount=code_block_11)
startPoint_2 = Curve.StartPoint(curve=dropItems)
join = List.Join(list0=dropItems_2, list1=startPoint_2)
byPoints = PolyCurve.ByPoints(points=join)
code_block_12 = CodeBlock { 600; }
gt_2 = length > code_block_12
filterByBoolMask_3 = List.FilterByBoolMask(list=flatten_2, mask=gt_2)
flatten_5 = List.Flatten(list=filterByBoolMask_3.in)
extractUpperFacesOfElement = Custom[ExtractUpperFacesOfElement](Element=valueAtKey)  # ExtractUpperFacesOfElement
watch_7 = Watch(extractUpperFacesOfElement.Surface)
flatten_6 = List.Flatten(list=watch_7)
byJoinedSurfaces = PolySurface.ByJoinedSurfaces(surfaces=flatten_6)
doesIntersect_2 = Geometry.DoesIntersect(geometry=byJoinedSurfaces, other=flatten_5, lacing=CrossProduct)
filterByBoolMask_4 = List.FilterByBoolMask(list=flatten_5, mask=doesIntersect_2@L2)
flatten_7 = List.Flatten(list=filterByBoolMask_4.in)
byJoinedCurves = PolyCurve.ByJoinedCurves(curves=flatten_7)
bySweep = Surface.BySweep(profile=byPoints, path=byJoinedCurves)
code_block_13 = CodeBlock(a=geometry) { a[1]; }
explode_3 = Geometry.Explode(geometry=code_block_13)
code_block_14 = CodeBlock { 150000; }
area_2 = Surface.Area(surface=explode_3)
round_2 = Math.Round(number=area_2)
gt_3 = code_block_14 > round_2
filterByBoolMask_5 = List.FilterByBoolMask(list=explode_3, mask=gt_3)
flatten_8 = List.Flatten(list=filterByBoolMask_5.in)
perimeterCurves_3 = Surface.PerimeterCurves(surface=flatten_8)
code_block_15 = CodeBlock { 0.5; }
pointAtParameter_2 = Surface.PointAtParameter(surface=flatten_8, u=code_block_15, v=code_block_15)
startPoint_3 = Curve.StartPoint(curve=perimeterCurves_3)
byStartPointEndPoint_2 = Line.ByStartPointEndPoint(startPoint=pointAtParameter_2, endPoint=startPoint_3)
length_3 = Curve.Length()  # unwired: curve
minimumItemByKey_2 = List.MinimumItemByKey(list=byStartPointEndPoint_2@L2, keyFunction=length_3)
doesIntersect_3 = Geometry.DoesIntersect(geometry=minimumItemByKey_2, other=perimeterCurves_3)
filterByBoolMask_6 = List.FilterByBoolMask(list=perimeterCurves_3, mask=doesIntersect_3)
flatten_9 = List.Flatten(list=filterByBoolMask_6.in)
watch_8 = Watch(flatten_9)
count = List.Count(list=watch_8)
code_block_16 = CodeBlock(a=count) { (2-a); }
dropItems_3 = List.DropItems(list=watch_8, amount=code_block_16)
endPoint_2 = Curve.EndPoint(curve=dropItems_3)
code_block_17 = CodeBlock { -1; }
dropItems_4 = List.DropItems(list=endPoint_2, amount=code_block_17)
startPoint_4 = Curve.StartPoint(curve=dropItems_3)
join_2 = List.Join(list0=dropItems_4, list1=startPoint_4)
byPoints_2 = PolyCurve.ByPoints(points=join_2)
watch_9 = Watch(extractSideFacesOfElement.Surface)
watch_10 = Watch(watch_9)
code_block_18 = CodeBlock { 1; }
flatten_10 = List.Flatten(list=watch_10, amt=code_block_18)
code_block_19 = CodeBlock(a=flatten_10) { a[1]; }
explode_4 = Geometry.Explode(geometry=code_block_19)
perimeterCurves_4 = Surface.PerimeterCurves(surface=explode_4)
flatten_11 = List.Flatten(list=perimeterCurves_4)
length_4 = Curve.Length(curve=flatten_11)
code_block_20 = CodeBlock { 600; }
gt_4 = length_4 > code_block_20
filterByBoolMask_7 = List.FilterByBoolMask(list=flatten_11, mask=gt_4)
flatten_12 = List.Flatten(list=filterByBoolMask_7.in)
watch_11 = Watch(extractUpperFacesOfElement.Surface)
flatten_13 = List.Flatten(list=watch_11)
byJoinedSurfaces_2 = PolySurface.ByJoinedSurfaces(surfaces=flatten_13)
doesIntersect_4 = Geometry.DoesIntersect(geometry=byJoinedSurfaces_2, other=flatten_12, lacing=CrossProduct)
filterByBoolMask_8 = List.FilterByBoolMask(list=flatten_12, mask=doesIntersect_4@L2)
flatten_14 = List.Flatten(list=filterByBoolMask_8.in)
byJoinedCurves_2 = PolyCurve.ByJoinedCurves(curves=flatten_14)
bySweep_2 = Surface.BySweep(profile=byPoints_2, path=byJoinedCurves_2)
uniqueItems_3 = List.UniqueItems(list=length_4)
watch_12 = Watch(uniqueItems_3)
sort_2 = List.Sort(list=watch_12)
watch_13 = Watch(sort_2)
uniqueItems_4 = List.UniqueItems(list=round_2)

# group: 사선 + 하부 모델링 업데이트 및 확정 후 재 확인
code_block_21 = CodeBlock {  }
code_block_22 = CodeBlock {  }

watch_14 = Watch(geometry)
flatten_15 = List.Flatten(list=watch_14)
explode_5 = Geometry.Explode(geometry=flatten_15)
code_block_23 = CodeBlock { 150000; }
area_3 = Surface.Area(surface=explode_5)
round_3 = Math.Round(number=area_3)
gt_5 = code_block_23 > round_3
filterByBoolMask_9 = List.FilterByBoolMask(list=explode_5, mask=gt_5)
watch_15 = Watch(filterByBoolMask_9.in)
perimeterCurves_5 = Surface.PerimeterCurves(surface=watch_15)
code_block_24 = CodeBlock { 0.5; }
pointAtParameter_3 = Surface.PointAtParameter(surface=watch_15, u=code_block_24, v=code_block_24)
startPoint_5 = Curve.StartPoint(curve=perimeterCurves_5)
byStartPointEndPoint_3 = Line.ByStartPointEndPoint(startPoint=pointAtParameter_3, endPoint=startPoint_5)
length_5 = Curve.Length()  # unwired: curve
minimumItemByKey_3 = List.MinimumItemByKey(list=byStartPointEndPoint_3@L2, keyFunction=length_5)
count_2 = List.Count(list=byStartPointEndPoint_3)
chop = List.Chop(list=minimumItemByKey_3, lengths=count_2)
doesIntersect_5 = Geometry.DoesIntersect(geometry=chop@L2, other=perimeterCurves_5@L3)
filterByBoolMask_10 = List.FilterByBoolMask(list=perimeterCurves_5@L3, mask=doesIntersect_5@L3)
flatten_16 = List.Flatten(list=filterByBoolMask_10.in)
flatten_17 = List.Flatten(list=filterByBoolMask_9.in)
uniqueItems_5 = List.UniqueItems(list=round_3)
watch_16 = Watch(extractSideFacesOfElement.Surface)
watch_17 = Watch(watch_16)
code_block_25 = CodeBlock { 1; }
flatten_18 = List.Flatten(list=watch_17, amt=code_block_25)
code_block_26 = CodeBlock(a=flatten_18) { a[1]; }
watch_18 = Watch(filterByBoolMask_10.in)
watch_19 = Watch(watch_18)

# group: 프로파일 선택
watch_20 = Watch(watch_19)
code_block_27 = CodeBlock { 1; }
dropItems_5 = List.DropItems(list=watch_20@L3, amount=code_block_27)

byJoinedCurves_3 = PolyCurve.ByJoinedCurves(curves=dropItems_5)
watch_21 = Watch(flatten_18)
perimeterCurves_6 = Surface.PerimeterCurves(surface=watch_21)
code_block_28 = CodeBlock { -1; }
flatten_19 = List.Flatten(list=perimeterCurves_6@L3, amt=code_block_28)
length_6 = Curve.Length(curve=flatten_19)
code_block_29 = CodeBlock { 600; }
gt_6 = length_6 > code_block_29
filterByBoolMask_11 = List.FilterByBoolMask(list=flatten_19, mask=gt_6)
watch_22 = Watch(filterByBoolMask_11.in)
watch_23 = Watch(extractUpperFacesOfElement.Surface)
flatten_20 = List.Flatten(list=watch_23)
byJoinedSurfaces_3 = PolySurface.ByJoinedSurfaces(surfaces=flatten_20)
doesIntersect_6 = Geometry.DoesIntersect(geometry=byJoinedSurfaces_3, other=watch_22, lacing=CrossProduct)
filterByBoolMask_12 = List.FilterByBoolMask(list=watch_22, mask=doesIntersect_6)
byJoinedCurves_4 = PolyCurve.ByJoinedCurves(curves=filterByBoolMask_12.in)
watch_24 = Watch(byJoinedCurves_4)
bySweep_3 = Surface.BySweep(profile=byJoinedCurves_3, path=watch_24)
code_block_30 = CodeBlock {  }
code_block_31 = CodeBlock {  }
