# Dynamo graph Slab Edge, Railings,Furniture,Ramp_DataStructureTest(0825).dyn (Dynamo 2.10.1.3976)

join = List.Join()  # unwired: list0

# group: Primary Input
categories = Categories("OST_EdgeSlab")
all_elements_of_category = ElementsOfCategory(Category=categories)
file_path = Filename(".\BIM_물량집계 자동화 산출기준표_rC(20210729).xlsx")
file_from_path = FileObject(path=file_path)
code_block = CodeBlock { "Slab Edges"; }

# group: GetFull WMCodeDescription PerElement
getFullWMCodeDescriptionPerElement = Custom[GetFullWMCodeDescriptionPerElement](InputElement=all_elements_of_category, InputFilePath=file_from_path, InputSheetName=code_block)  # GetFullWMCodeDescriptionPerElement

# group: OrganizeAllElementInformAsDictionary
organizeAllElementInformAsDictionary = Custom[OrganizeAllElementInformAsDictionary](InputDic=getFullWMCodeDescriptionPerElement.Dictionary)  # OrganizeAllElementInformAsDictionary

# group: Select Target Family Element And Connected WorkMasters
code_block_2 = CodeBlock { 0; }
selectTargetFamilyInformAsDictionary = Custom[SelectTargetFamilyInformAsDictionary](InputDic=organizeAllElementInformAsDictionary, InputIndex=code_block_2)  # Select Target Family Element And Connected WorkMasters

watch = Watch(selectTargetFamilyInformAsDictionary)
code_block_3 = CodeBlock(i=watch) { i; }

# group: TargetWMunique + Data Sending
code_block_4 = CodeBlock(InputDic2=join) { _InputDic2; }
count = List.Count(list=code_block_4)
code_block_5 = CodeBlock(InputDic1=code_block_3) { _InputDic1; }
code_block_6 = CodeBlock { "TargetWMunique"; }
valueAtKey = DesignScript.Builtin.Dictionary.ValueAtKey(dictionary=code_block_5, key=code_block_6)
watch_2 = Watch(valueAtKey)
count_2 = List.Count(list=watch_2)
eq = count == count_2
organizeFuncValuesAndWorkMasterAsDiction = Custom[OrganizeFuncValuesAndWorkMasterAsDictionary](InputDic1=code_block_5, InputDic2=code_block_4)  # Organize FuncValues and WorkMaster As Dictionary
watch_3 = Watch()  # unwired: arg0
if_ = If(test=eq, true=organizeFuncValuesAndWorkMasterAsDiction, false=watch_3)

# group: 데이터 취합 및 Row 방향 정렬
code_block_7 = CodeBlock(InputDic=if_) { _InputDic; }
code_block_8 = CodeBlock { "TrTargetFamilyCode"; }
valueAtKey_2 = DesignScript.Builtin.Dictionary.ValueAtKey(dictionary=code_block_7, key=code_block_8)
watch_4 = Watch(valueAtKey_2)
flatten = List.Flatten(list=watch_4)
code_block_9 = CodeBlock { "WMforTargetElements"; }
valueAtKey_3 = DesignScript.Builtin.Dictionary.ValueAtKey(dictionary=code_block_7, key=code_block_9)
watch_5 = Watch(valueAtKey_3)
flatten_2 = List.Flatten(list=watch_5)
code_block_10 = CodeBlock { "TargetFuncValues"; }
valueAtKey_4 = DesignScript.Builtin.Dictionary.ValueAtKey(dictionary=code_block_7, key=code_block_10)
watch_6 = Watch(valueAtKey_4)
flatten_3 = List.Flatten(list=watch_6)
code_block_11 = CodeBlock { "TargetFuncValuesUnit"; }
valueAtKey_5 = DesignScript.Builtin.Dictionary.ValueAtKey(dictionary=code_block_7, key=code_block_11)
watch_7 = Watch(valueAtKey_5)
flatten_4 = List.Flatten(list=watch_7)
list_create = List.Create(item0=flatten, item1=flatten_2, item2=flatten_3, item3=flatten_4)
transpose = List.Transpose(lists=list_create)

# group: 패밀리 별 취합 + Export Excel(By OpenpyXl)
# note: Excel Export Button
boolean = BoolSelector(true)
join_2 = List.Join(list0=transpose)
watch_8 = Watch()  # unwired: arg0
if_2 = If(test=boolean, true=join_2, false=watch_8)
python_script_export_excel_by = Python(IN[0]=if_2)  # "Python Script@Export Excel(By OpenpyXl)"; CPython3
# ---------- python_script_export_excel_by.python (151 lines) ----------
# Load the Python Standard and DesignScript Libraries
import sys
import os
#sys.path.append(r'C:\Users\HEC\AppData\Local\Programs\Python\Python39\Lib\site-packages')
#sys.path.append(r'C:\Users\pjmk0\AppData\Local\Programs\Python\Python39\Lib\site-packages')
sys.path.append(os.getenv('LOCALAPPDATA').replace('\\','\\\\') + r'\Programs\Python\Python39\Lib\site-packages')
import clr
clr.AddReference('ProtoGeometry')
from Autodesk.DesignScript.Geometry import *
from collections import Iterable

def iterable(obj):
    return isinstance(obj, Iterable)


# The inputs to this node will be stored as a list in the IN variables.
dataEnteringNode = IN
ListIn = IN[0]

# Place your code below this line
import datetime
from datetime import date, timedelta
Today = date.today()
import openpyxl
from openpyxl.styles import Border, Side, PatternFill, Font, GradientFill, Alignment, Color, numbers

sample_items = ListIn


def write_to_file(filepath):
    wb = openpyxl.Workbook()
    for sheet in wb.sheetnames:
        wb.remove(wb[sheet])

    thin = Side(border_style="thin", color="000000")
    double = Side(border_style="double", color="000000")

    ws = wb.create_sheet(title='Wall_Calc_instance', index=0)

    ws.merge_cells('A1:L1')
    ws['A1'] = 'HEC Wall Category Calculation Sheet'
    cell = ws['A1']
    cell.font = openpyxl.styles.Font(color='000000', size=20)
    cell.fill = openpyxl.styles.fills.PatternFill(patternType='solid',
                                                  fgColor=openpyxl.styles.colors.Color(rgb='fff3b0'))

    ws['A2'] = 'Item Number'
    ws['A2'].font = openpyxl.styles.Font(b=True, color='000000', size=12)
    #ws['B2'] = 'Member Name'
    #ws['B2'].font = openpyxl.styles.Font(b=True, color='000000', size=12)
    #ws['C2'] = 'Category'
    #ws['C2'].font = openpyxl.styles.Font(b=True, color='000000', size=12)
    ws['B2'] = 'Family Type'
    ws['B2'].font = openpyxl.styles.Font(b=True, color='000000', size=12)
    ws['C2'] = 'WorkMaster Code'
    ws['C2'].font = openpyxl.styles.Font(b=True, color='000000', size=12)
    #ws['F2'] = 'WorkMaster Description'
    #ws['F2'].font = openpyxl.styles.Font(b=True, color='000000', size=12)
    #ws['G2'] = 'Unit'
    #ws['G2'].font = openpyxl.styles.Font(b=True, color='000000', size=12)
    #ws['H2'] = '계수'
    #ws['H2'].font = openpyxl.styles.Font(b=True, color='000000', size=12)
    #ws['I2'] = '계산 참조값'
    #ws['I2'].font = openpyxl.styles.Font(b=True, color='000000', size=12)
    ws['D2'] = 'Quantities'
    ws['D2'].font = openpyxl.styles.Font(b=True, color='000000', size=12)
    ws['E2'] = 'Unit'
    ws['E2'].font = openpyxl.styles.Font(b=True, color='000000', size=12)
    ws['F2'] = 'Unit Price'
    ws['F2'].font = openpyxl.styles.Font(b=True, color='000000', size=12)
    ws['G2'] = 'Total Price'
    ws['G2'].font = openpyxl.styles.Font(b=True, color='000000', size=12)


## 칼럼별 너비 조정 구간
#    for col in range(ws.max_column):
#        ws.column_dimensions[chr(ord('A') + col)].width = 15
    ws.column_dimensions['A'].width = 15
    ws.column_dimensions['B'].width = 45
    ws.column_dimensions['C'].width = 60
    ws.column_dimensions['D'].width = 20
    ws.column_dimensions['E'].width = 20
    ws.column_dimensions['F'].width = 20
    ws.column_dimensions['G'].width = 20
    #ws.column_dimensions['G'].width = 9
    #ws.column_dimensions['H'].width = 9
    #ws.column_dimensions['H'].hidden = True
    #ws.column_dimensions['I'].width = 12
    #ws.column_dimensions['I'].hidden = True
    #ws.column_dimensions['J'].width = 12
    #ws.column_dimensions['K'].width = 12
    #ws.column_dimensions['L'].width = 12

###
    start_row = 3
    for (row, item) in enumerate(sample_items, start_row):
        cell = ws.cell(row=row, column=1, value=row - 2)
        cell.alignment = openpyxl.styles.Alignment(horizontal='center', vertical='center')

#        cell = ws.cell(row=row, column=2, value=item[0])
#        cell.number_format = openpyxl.styles.numbers.FORMAT_DATE_YYYYMMDD2  # 'yyyy-mm-dd'
        ws.cell(row=row, column=2, value=item[0]) ## Family Type 칼럼

        ws.cell(row=row, column=3, value=item[1]) ## WorkMaster Code 칼럼
        
        ws.cell(row=row, column=4, value=item[2]) ## Quantities 칼럼
        
        ws.cell(row=row, column=5, value=item[3]) ## Unit 칼럼
        
        #cell = ws.cell(row=row, column=8, value=item[6]) ## 계수 칼럼
        #cell.number_format = openpyxl.styles.numbers.builtin_format_code(3)  # '#,##0'
        
        #cell = ws.cell(row=row, column=9, value=item[7]) ## 계산 참조값 칼럼
        #cell.number_format = openpyxl.styles.numbers.builtin_format_code(3)  # '#,##0'
        
        #cell = ws.cell(row=row, column=10, value=item[8]) ## Quantities 칼럼
        #cell.number_format = openpyxl.styles.numbers.builtin_format_code(3)  # '#,##0'
        #cell.font = openpyxl.styles.Font(b=True, color='000000', size=11)

        cell = ws.cell(row=row, column=7, value='= D{current_row}*F{current_row}'.format(current_row=cell.row))
        cell.number_format = '#,##0'

#        cell = ws.cell(row=row, column=6, value='= D{current_row} * E{current_row}'.format(current_row=cell.row))
#        cell.number_format = openpyxl.styles.numbers.builtin_format_code(3)

    total_row = ws.max_row + 1
    if total_row > start_row:
        cell1 = ws.cell(row=total_row, column=6, value='Total')
        cell1.font = openpyxl.styles.Font(b=True, color='000000', size=15)
        
        cell2 = ws.cell(row=total_row, column=7, value='= SUM(G{}:G{})'.format(start_row, total_row - 1))
        cell2.number_format = openpyxl.styles.numbers.builtin_format_code(3)
        cell2.border = Border(top=double, left=double, right=double, bottom=double)
        cell2.font = openpyxl.styles.Font(b=True, color='ff03ce', size=15)
    

    wb.save(filepath)
    wb.close()


##if __name__ == '__main__':
#write_to_file('C:\\Users\\pjmk0\\AppData\\Roaming\\test.xlsx')

save_name = "HecStrFDNCalcSheet_" + Today.strftime("%Y-%m-%d")+".xlsx"
path = os.getenv('APPDATA').replace('\\','\\\\')
filePath = path + '\\' + save_name

write_to_file(filePath)

# Assign your output to the OUT variable.
OUT = os.getenv('APPDATA')
# ----------------------------------------

# group: <Func 1> 콘크리트 체적
code_block_12 = CodeBlock { "TargetElements"; }
valueAtKey_6 = DesignScript.Builtin.Dictionary.ValueAtKey(dictionary=code_block_3, key=code_block_12)
# note: <Func>
geometry = Element.Geometry(element=valueAtKey_6)
flatten_5 = List.Flatten(list=geometry@L2)
volume = Solid.Volume(solid=flatten_5)
flatten_6 = List.Flatten(list=volume)
sum = Math.Sum(values=flatten_6)
code_block_13 = CodeBlock(i=sum) { Math.Round(List.Flatten(i)/1000000000, 2); }
code_block_14 = CodeBlock { "M3"; }
count_3 = List.Count(list=code_block_13)
ofRepeatedItem = List.OfRepeatedItem(item=code_block_14, amount=count_3)
code_block_15 = CodeBlock(FuncValues=code_block_13, FuncValuesUnit=ofRepeatedItem)
# ---------- code_block_15.designscript (4 lines) ----------
{
"FuncValues": _FuncValues,
"FuncValuesUnit": _FuncValuesUnit
};
# ----------------------------------------

watch_9 = Watch(code_block_15)

# group: <Func 2> 측면 면적산출
code_block_16 = CodeBlock { "TargetElements"; }
valueAtKey_7 = DesignScript.Builtin.Dictionary.ValueAtKey(dictionary=code_block_3, key=code_block_16)
extractSideFacesOfElement = Custom[ExtractSideFacesOfElement](Element=valueAtKey_7)  # ExtractSideFacesOfElement
flatten_7 = List.Flatten(list=extractSideFacesOfElement.Surface)
area = Surface.Area(surface=flatten_7)
sum_2 = Math.Sum(values=area)
code_block_17 = CodeBlock(i=sum_2) { Math.Round(List.Flatten(i)/1000000, 2); }
code_block_18 = CodeBlock { "M2"; }
count_4 = List.Count(list=code_block_17)
ofRepeatedItem_2 = List.OfRepeatedItem(item=code_block_18, amount=count_4)
code_block_19 = CodeBlock(FuncValues=code_block_17, FuncValuesUnit=ofRepeatedItem_2)  # same code as code_block_15
# note: <Func>
geometry_2 = Element.Geometry(element=valueAtKey_7@L1)

watch_10 = Watch(code_block_19)

# group: <Func 3> 콘크리트 체적 선택
code_block_20 = CodeBlock { "TargetElements"; }
valueAtKey_8 = DesignScript.Builtin.Dictionary.ValueAtKey(key=code_block_20)  # unwired: dictionary
# note: <Func>
geometry_3 = Element.Geometry(element=valueAtKey_8)
flatten_8 = List.Flatten(list=geometry_3@L2)
volume_2 = Solid.Volume(solid=flatten_8)
flatten_9 = List.Flatten(list=volume_2)
sum_3 = Math.Sum(values=flatten_9)
# note: 비율 추가
code_block_21 = CodeBlock(i=sum_3) { Math.Round(List.Flatten(i)/1000000000, 2); }
code_block_22 = CodeBlock { "M3"; }
count_5 = List.Count(list=code_block_21)
ofRepeatedItem_3 = List.OfRepeatedItem(item=code_block_22, amount=count_5)
code_block_23 = CodeBlock(FuncValues=code_block_21, FuncValuesUnit=ofRepeatedItem_3)  # same code as code_block_15

watch_11 = Watch(code_block_23)

# group: <Func 4> 계단 하부노출면
code_block_24 = CodeBlock { "TargetElements"; }
valueAtKey_9 = DesignScript.Builtin.Dictionary.ValueAtKey(key=code_block_24)  # unwired: dictionary
geometry_4 = Element.Geometry(element=valueAtKey_9)
explode = Geometry.Explode(geometry=geometry_4)
flatten_10 = List.Flatten(list=explode)
# note: <Func>
extractUpperFacesOfElement = Custom[ExtractUpperFacesOfElement](Element=valueAtKey_9)  # ExtractUpperFacesOfElement
flatten_11 = List.Flatten(list=extractUpperFacesOfElement.Surface)
byJoinedSurfaces = PolySurface.ByJoinedSurfaces(surfaces=flatten_11)
doesIntersect = Geometry.DoesIntersect(geometry=byJoinedSurfaces, other=flatten_10, lacing=CrossProduct)
filterByBoolMask = List.FilterByBoolMask(list=flatten_10, mask=doesIntersect@L2)
flatten_12 = List.Flatten(list=filterByBoolMask.out)
area_2 = Surface.Area(surface=flatten_12)
sum_4 = Math.Sum(values=area_2)
code_block_25 = CodeBlock(i=sum_4) { Math.Round(List.Flatten(i)/1000000, 2); }
code_block_26 = CodeBlock { "M2"; }
count_6 = List.Count(list=code_block_25)
ofRepeatedItem_4 = List.OfRepeatedItem(item=code_block_26, amount=count_6)
code_block_27 = CodeBlock(FuncValues=code_block_25, FuncValuesUnit=ofRepeatedItem_4)  # same code as code_block_15

watch_12 = Watch(code_block_27)

# group: <Func 5> 계단 상부노출면
code_block_28 = CodeBlock { "TargetElements"; }
valueAtKey_10 = DesignScript.Builtin.Dictionary.ValueAtKey(key=code_block_28)  # unwired: dictionary
# note: <Func>
extractUpperFacesOfElement_2 = Custom[ExtractUpperFacesOfElement](Element=valueAtKey_10)
flatten_13 = List.Flatten(list=extractUpperFacesOfElement_2.Surface)
area_3 = Surface.Area(surface=flatten_13)
sum_5 = Math.Sum(values=area_3)
code_block_29 = CodeBlock(i=sum_5) { Math.Round(List.Flatten(i)/1000000, 2); }
code_block_30 = CodeBlock { "M2"; }
count_7 = List.Count(list=code_block_29)
ofRepeatedItem_5 = List.OfRepeatedItem(item=code_block_30, amount=count_7)
code_block_31 = CodeBlock(FuncValues=code_block_29, FuncValuesUnit=ofRepeatedItem_5)  # same code as code_block_15

watch_13 = Watch(code_block_31)

# group: <Func 6,8> 계단과 벽체가 만나는 지점에서 Nosing을 잇는 선을 100mm offset하고 그 경계 하부 면적을 계산
area_4 = Surface.Area()  # unwired: surface
sum_6 = Math.Sum(values=area_4)
code_block_32 = CodeBlock(i=sum_6) { Math.Round(List.Flatten(i)/1000000, 2); }
code_block_33 = CodeBlock { "M2"; }
count_8 = List.Count(list=code_block_32)
ofRepeatedItem_6 = List.OfRepeatedItem(item=code_block_33, amount=count_8)
code_block_34 = CodeBlock(FuncValues=code_block_32, FuncValuesUnit=ofRepeatedItem_6)  # same code as code_block_15
# note: <Func>
code_block_35 = CodeBlock { "TargetElements"; }
valueAtKey_11 = DesignScript.Builtin.Dictionary.ValueAtKey(key=code_block_35)  # unwired: dictionary

watch_14 = Watch(code_block_34)
geometry_5 = Element.Geometry(element=valueAtKey_11)
explode_2 = Geometry.Explode(geometry=geometry_5)
flatten_14 = List.Flatten(list=explode_2)
# note: <Func>
extractUpperFacesOfElement_3 = Custom[ExtractUpperFacesOfElement](Element=valueAtKey_11)
flatten_15 = List.Flatten(list=extractUpperFacesOfElement_3.Surface)
byJoinedSurfaces_2 = PolySurface.ByJoinedSurfaces(surfaces=flatten_15)
doesIntersect_2 = Geometry.DoesIntersect(geometry=byJoinedSurfaces_2, other=flatten_14, lacing=CrossProduct)
filterByBoolMask_2 = List.FilterByBoolMask(list=flatten_14, mask=doesIntersect_2@L2)
perimeterCurves = Surface.PerimeterCurves(surface=filterByBoolMask_2.out@L1)
startPoint = Curve.StartPoint(curve=perimeterCurves)
boolean_2 = BoolSelector(true)
byPoints = PolyCurve.ByPoints(points=startPoint, connectLastToFirst=boolean_2)
flatten_16 = List.Flatten(list=filterByBoolMask_2.out)
code_block_36 = CodeBlock { 450; }
translate = Geometry.Translate(geometry=flatten_16, zTranslation=code_block_36)
perimeterCurves_2 = Surface.PerimeterCurves(surface=translate)
startPoint_2 = Curve.StartPoint(curve=perimeterCurves_2)
boolean_3 = BoolSelector(true)
byPoints_2 = PolyCurve.ByPoints(points=startPoint_2, connectLastToFirst=boolean_3)
list_create_2 = List.Create(item0=byPoints, item1=byPoints_2)
transpose_2 = List.Transpose(lists=list_create_2)
byLoft = Solid.ByLoft(crossSections=transpose_2)
isNull = Object.IsNull(object=byLoft)
filterByBoolMask_3 = List.FilterByBoolMask(list=byLoft, mask=isNull)
byUnion = Solid.ByUnion(solids=filterByBoolMask_3.out)
geometry_6 = Element.Geometry(element=valueAtKey_11)
flatten_17 = List.Flatten(list=geometry_6)
byUnion_2 = Solid.ByUnion(solids=flatten_17)
differenceAll = Solid.DifferenceAll(solid=byUnion, others=byUnion_2)
explode_3 = Geometry.Explode(geometry=differenceAll)
code_block_37 = CodeBlock { 0.5; }
normalAtParameter = Surface.NormalAtParameter(surface=explode_3, u=code_block_37, v=code_block_37)

# group: func2 (ExtractSideFacesOfElement)
Z = Vector.Z(vector=normalAtParameter)
code_block_38 = CodeBlock { 0; }
round = Math.Round(number=Z, digits=code_block_38)
code_block_39 = CodeBlock(i=round) { i<1 && i>-1; }
filterByBoolMask_4 = List.FilterByBoolMask(list=explode_3, mask=code_block_39)
color_palette = ColorPalette({R: 255, G: 0, B: 255, A: 136})
byGeometryColor = Modifiers.GeometryColor.ByGeometryColor(geometry=filterByBoolMask_4.in, color=color_palette)
code_block_40 = CodeBlock { Surface; }
code_block_41 = CodeBlock { GeometryColor; }

byStartPointEndPoint = Line.ByStartPointEndPoint()  # unwired: startPoint, endPoint
Z_2 = Point.Z()  # unwired: point
sort = List.Sort(list=Z_2)
watch_15 = Watch(filterByBoolMask_4.in)
separate = Solid.Separate(solid=differenceAll)
doesIntersect_3 = Geometry.DoesIntersect(geometry=separate, other=watch_15, lacing=CrossProduct)
filterByBoolMask_5 = List.FilterByBoolMask(list=watch_15, mask=doesIntersect_3@L2)
watch_16 = Watch(filterByBoolMask_5.in)
watch_17 = Watch(filterByBoolMask_4.out)
separate_2 = Solid.Separate(solid=differenceAll)
doesIntersect_4 = Geometry.DoesIntersect(geometry=separate_2, other=watch_17, lacing=CrossProduct)
filterByBoolMask_6 = List.FilterByBoolMask(list=watch_17, mask=doesIntersect_4@L2)
watch_18 = Watch(filterByBoolMask_6.in)
area_5 = Surface.Area(surface=watch_18)
code_block_42 = CodeBlock { 0; }
round_2 = Math.Round(number=area_5, digits=code_block_42)
area_6 = Surface.Area()  # unwired: surface
minimumItemByKey = List.MinimumItemByKey(list=watch_18@L2, keyFunction=area_6)
watch_19 = Watch(minimumItemByKey)
area_7 = Surface.Area(surface=watch_19)
code_block_43 = CodeBlock { 0; }
round_3 = Math.Round(number=area_7, digits=code_block_43)
eq_2 = round_2@L2 == round_3@L1  # lacing=Shortest
filterByBoolMask_7 = List.FilterByBoolMask(list=watch_18@L2, mask=eq_2@L2)
flatten_18 = List.Flatten(list=filterByBoolMask_7.in)
flatten_19 = List.Flatten(list=flatten_18)
countTrue = List.CountTrue(list=eq_2@L2)
code_block_44 = CodeBlock(a=countTrue) { a/2; }
code_block_45 = CodeBlock { 2; }
ofRepeatedItem_7 = List.OfRepeatedItem(item=code_block_44, amount=code_block_45)
transpose_3 = List.Transpose(lists=ofRepeatedItem_7)
flatten_20 = List.Flatten(list=transpose_3)
chop = List.Chop(list=flatten_19, lengths=flatten_20)
code_block_46 = CodeBlock { 0.5; }
pointAtParameter = Surface.PointAtParameter(surface=chop, u=code_block_46, v=code_block_46)
byPoints_3 = PolyCurve.ByPoints(points=pointAtParameter)
code_block_47 = CodeBlock { 200; }
extendStart = Curve.ExtendStart(curve=byPoints_3, distance=code_block_47)
startPoint_3 = Curve.StartPoint(curve=extendStart)
code_block_48 = CodeBlock { 2; }
chop_2 = List.Chop(list=startPoint_3, lengths=code_block_48)
extendEnd = Curve.ExtendEnd(curve=byPoints_3, distance=code_block_47)
endPoint = Curve.EndPoint(curve=extendEnd)
code_block_49 = CodeBlock { 2; }
chop_3 = List.Chop(list=endPoint, lengths=code_block_49)
addItemToFront = List.AddItemToFront(item=chop_2@L2, list=chop_3@L2)
flatten_21 = List.Flatten(list=addItemToFront@L3)
sortByFunction = List.SortByFunction(list=flatten_21@L2, sortFunction=Z_2)
byPoints_4 = PolyCurve.ByPoints(points=sortByFunction)
doesIntersect_5 = Geometry.DoesIntersect(geometry=watch_16@L2, other=byPoints_4@L1)
filterByBoolMask_8 = List.FilterByBoolMask(list=watch_16, mask=doesIntersect_5)
watch_20 = Watch(filterByBoolMask_8.out)
code_block_50 = CodeBlock { 1200; }
translate_2 = Geometry.Translate(geometry=byPoints_4, zTranslation=code_block_50)
list_create_3 = List.Create(item0=byPoints_4, item1=translate_2)
transpose_4 = List.Transpose(lists=list_create_3)
byLoft_2 = Surface.ByLoft(crossSections=transpose_4)
code_block_51 = CodeBlock { 300; }
thicken = Surface.Thicken(surface=byLoft_2, thickness=code_block_51)
doesIntersect_6 = Geometry.DoesIntersect(geometry=watch_20@L2, other=thicken@L1)
filterByBoolMask_9 = List.FilterByBoolMask(list=watch_20, mask=doesIntersect_6)
flatten_22 = List.Flatten(list=filterByBoolMask_9.out)

# group: <Func 7,9,10> 계단 상부노출면 + Riser 노출면
code_block_52 = CodeBlock { "TargetElements"; }
valueAtKey_12 = DesignScript.Builtin.Dictionary.ValueAtKey(key=code_block_52)  # unwired: dictionary
# note: <Func>
extractUpperFacesOfElement_4 = Custom[ExtractUpperFacesOfElement](Element=valueAtKey_12)
flatten_23 = List.Flatten(list=extractUpperFacesOfElement_4.Surface)
flatten_24 = List.Flatten(list=filterByBoolMask_8.in)
list_create_4 = List.Create(item0=flatten_23, item1=flatten_24)
flatten_25 = List.Flatten(list=list_create_4)
area_8 = Surface.Area(surface=flatten_25)
sum_7 = Math.Sum(values=area_8)
code_block_53 = CodeBlock(i=sum_7) { Math.Round(List.Flatten(i)/1000000, 2); }
code_block_54 = CodeBlock { "M2"; }
count_9 = List.Count(list=code_block_53)
ofRepeatedItem_8 = List.OfRepeatedItem(item=code_block_54, amount=count_9)
code_block_55 = CodeBlock(FuncValues=code_block_53, FuncValuesUnit=ofRepeatedItem_8)  # same code as code_block_15
watch_21 = Watch(code_block_55)

watch_22 = Watch(extractSideFacesOfElement.Surface)
watch_23 = Watch(watch_22)
code_block_56 = CodeBlock { 1; }
flatten_26 = List.Flatten(list=watch_23, amt=code_block_56)
code_block_57 = CodeBlock(a=flatten_26) { a[0]; }
explode_4 = Geometry.Explode(geometry=code_block_57)
perimeterCurves_3 = Surface.PerimeterCurves(surface=explode_4)
flatten_27 = List.Flatten(list=perimeterCurves_3)
length = Curve.Length(curve=flatten_27)
uniqueItems = List.UniqueItems(list=length)
watch_24 = Watch(uniqueItems)
sort_2 = List.Sort(list=watch_24)
watch_25 = Watch(sort_2)
code_block_58 = CodeBlock(a=geometry_2) { a[0]; }
explode_5 = Geometry.Explode(geometry=code_block_58)
area_9 = Surface.Area(surface=explode_5)
round_4 = Math.Round(number=area_9)
uniqueItems_2 = List.UniqueItems(list=round_4)
code_block_59 = CodeBlock { 150000; }
gt = code_block_59 > round_4
filterByBoolMask_10 = List.FilterByBoolMask(list=explode_5, mask=gt)
flatten_28 = List.Flatten(list=filterByBoolMask_10.in)
perimeterCurves_4 = Surface.PerimeterCurves(surface=flatten_28)
code_block_60 = CodeBlock { 0.5; }
pointAtParameter_2 = Surface.PointAtParameter(surface=flatten_28, u=code_block_60, v=code_block_60)
startPoint_4 = Curve.StartPoint(curve=perimeterCurves_4)
byStartPointEndPoint_2 = Line.ByStartPointEndPoint(startPoint=pointAtParameter_2, endPoint=startPoint_4)
length_2 = Curve.Length()  # unwired: curve
minimumItemByKey_2 = List.MinimumItemByKey(list=byStartPointEndPoint_2@L2, keyFunction=length_2)
doesIntersect_7 = Geometry.DoesIntersect(geometry=minimumItemByKey_2, other=perimeterCurves_4)
filterByBoolMask_11 = List.FilterByBoolMask(list=perimeterCurves_4, mask=doesIntersect_7)
flatten_29 = List.Flatten(list=filterByBoolMask_11.in)
watch_26 = Watch(flatten_29)
code_block_61 = CodeBlock { 2; }
dropItems = List.DropItems(list=watch_26, amount=code_block_61)
endPoint_2 = Curve.EndPoint(curve=dropItems)
code_block_62 = CodeBlock { -1; }
dropItems_2 = List.DropItems(list=endPoint_2, amount=code_block_62)
startPoint_5 = Curve.StartPoint(curve=dropItems)
join_3 = List.Join(list0=dropItems_2, list1=startPoint_5)
byPoints_5 = PolyCurve.ByPoints(points=join_3)
code_block_63 = CodeBlock { 600; }
gt_2 = length > code_block_63
filterByBoolMask_12 = List.FilterByBoolMask(list=flatten_27, mask=gt_2)
flatten_30 = List.Flatten(list=filterByBoolMask_12.in)
extractUpperFacesOfElement_5 = Custom[ExtractUpperFacesOfElement](Element=valueAtKey_7)
watch_27 = Watch(extractUpperFacesOfElement_5.Surface)
flatten_31 = List.Flatten(list=watch_27)
byJoinedSurfaces_3 = PolySurface.ByJoinedSurfaces(surfaces=flatten_31)
doesIntersect_8 = Geometry.DoesIntersect(geometry=byJoinedSurfaces_3, other=flatten_30, lacing=CrossProduct)
filterByBoolMask_13 = List.FilterByBoolMask(list=flatten_30, mask=doesIntersect_8@L2)
flatten_32 = List.Flatten(list=filterByBoolMask_13.in)
byJoinedCurves = PolyCurve.ByJoinedCurves(curves=flatten_32)
bySweep = Surface.BySweep(profile=byPoints_5, path=byJoinedCurves)
code_block_64 = CodeBlock(a=geometry_2) { a[1]; }
explode_6 = Geometry.Explode(geometry=code_block_64)
code_block_65 = CodeBlock { 150000; }
area_10 = Surface.Area(surface=explode_6)
round_5 = Math.Round(number=area_10)
gt_3 = code_block_65 > round_5
filterByBoolMask_14 = List.FilterByBoolMask(list=explode_6, mask=gt_3)
flatten_33 = List.Flatten(list=filterByBoolMask_14.in)
perimeterCurves_5 = Surface.PerimeterCurves(surface=flatten_33)
code_block_66 = CodeBlock { 0.5; }
pointAtParameter_3 = Surface.PointAtParameter(surface=flatten_33, u=code_block_66, v=code_block_66)
startPoint_6 = Curve.StartPoint(curve=perimeterCurves_5)
byStartPointEndPoint_3 = Line.ByStartPointEndPoint(startPoint=pointAtParameter_3, endPoint=startPoint_6)
length_3 = Curve.Length()  # unwired: curve
minimumItemByKey_3 = List.MinimumItemByKey(list=byStartPointEndPoint_3@L2, keyFunction=length_3)
doesIntersect_9 = Geometry.DoesIntersect(geometry=minimumItemByKey_3, other=perimeterCurves_5)
filterByBoolMask_15 = List.FilterByBoolMask(list=perimeterCurves_5, mask=doesIntersect_9)
flatten_34 = List.Flatten(list=filterByBoolMask_15.in)
watch_28 = Watch(flatten_34)
count_10 = List.Count(list=watch_28)
code_block_67 = CodeBlock(a=count_10) { (2-a); }
dropItems_3 = List.DropItems(list=watch_28, amount=code_block_67)
endPoint_3 = Curve.EndPoint(curve=dropItems_3)
code_block_68 = CodeBlock { -1; }
dropItems_4 = List.DropItems(list=endPoint_3, amount=code_block_68)
startPoint_7 = Curve.StartPoint(curve=dropItems_3)
join_4 = List.Join(list0=dropItems_4, list1=startPoint_7)
byPoints_6 = PolyCurve.ByPoints(points=join_4)
watch_29 = Watch(extractSideFacesOfElement.Surface)
watch_30 = Watch(watch_29)
code_block_69 = CodeBlock { 1; }
flatten_35 = List.Flatten(list=watch_30, amt=code_block_69)
code_block_70 = CodeBlock(a=flatten_35) { a[1]; }
explode_7 = Geometry.Explode(geometry=code_block_70)
perimeterCurves_6 = Surface.PerimeterCurves(surface=explode_7)
flatten_36 = List.Flatten(list=perimeterCurves_6)
length_4 = Curve.Length(curve=flatten_36)
code_block_71 = CodeBlock { 600; }
gt_4 = length_4 > code_block_71
filterByBoolMask_16 = List.FilterByBoolMask(list=flatten_36, mask=gt_4)
flatten_37 = List.Flatten(list=filterByBoolMask_16.in)
watch_31 = Watch(extractUpperFacesOfElement_5.Surface)
flatten_38 = List.Flatten(list=watch_31)
byJoinedSurfaces_4 = PolySurface.ByJoinedSurfaces(surfaces=flatten_38)
doesIntersect_10 = Geometry.DoesIntersect(geometry=byJoinedSurfaces_4, other=flatten_37, lacing=CrossProduct)
filterByBoolMask_17 = List.FilterByBoolMask(list=flatten_37, mask=doesIntersect_10@L2)
flatten_39 = List.Flatten(list=filterByBoolMask_17.in)
byJoinedCurves_2 = PolyCurve.ByJoinedCurves(curves=flatten_39)
bySweep_2 = Surface.BySweep(profile=byPoints_6, path=byJoinedCurves_2)
uniqueItems_3 = List.UniqueItems(list=length_4)
watch_32 = Watch(uniqueItems_3)
sort_3 = List.Sort(list=watch_32)
watch_33 = Watch(sort_3)
uniqueItems_4 = List.UniqueItems(list=round_5)

# group: Primary Input
categories_2 = Categories("OST_RailingTopRail")
all_elements_of_category_2 = ElementsOfCategory(Category=categories_2)
file_path_2 = Filename(".\BIM_물량집계 자동화 산출기준표_rC(20210729).xlsx")
file_from_path_2 = FileObject(path=file_path_2)
code_block_72 = CodeBlock { "Railings"; }

# group: GetFull WMCodeDescription PerElement
getFullWMCodeDescriptionPerElement_2 = Custom[GetFullWMCodeDescriptionPerElement](InputElement=all_elements_of_category_2, InputFilePath=file_from_path_2, InputSheetName=code_block_72)  # frozen

# group: OrganizeAllElementInformAsDictionary
organizeAllElementInformAsDictionary_2 = Custom[OrganizeAllElementInformAsDictionary](InputDic=getFullWMCodeDescriptionPerElement_2.Dictionary)

# group: Select Target Family Element And Connected WorkMasters
code_block_73 = CodeBlock { 0; }
selectTargetFamilyInformAsDictionary_2 = Custom[SelectTargetFamilyInformAsDictionary](InputDic=organizeAllElementInformAsDictionary_2, InputIndex=code_block_73)

watch_34 = Watch(selectTargetFamilyInformAsDictionary_2)
code_block_74 = CodeBlock(i=watch_34) { i; }

# group: <Func 1> 길이합계 (Top Rails 길이 산출)
code_block_75 = CodeBlock { "TargetElements"; }
valueAtKey_13 = DesignScript.Builtin.Dictionary.ValueAtKey(dictionary=code_block_74, key=code_block_75)
code_block_76 = CodeBlock { "Length"; }
getParameterValueByName = Element.GetParameterValueByName(element=valueAtKey_13, parameterName=code_block_76)

# group: 사선 + 하부 모델링 업데이트 및 확정 후 재 확인
code_block_77 = CodeBlock {  }
code_block_78 = CodeBlock {  }

# group: <Func 2> 터파기 물량 콘크리트 체적의 1.2
code_block_79 = CodeBlock(a=code_block_13) { a*1.2; }
code_block_80 = CodeBlock { "M3"; }
count_11 = List.Count(list=code_block_79)
ofRepeatedItem_9 = List.OfRepeatedItem(item=code_block_80, amount=count_11)
code_block_81 = CodeBlock(FuncValues=code_block_79, FuncValuesUnit=ofRepeatedItem_9)  # same code as code_block_15

# group: <Func 3> Excavation 물량에 20% , Excavation 물량에 80%
watch_35 = Watch(code_block_79)
code_block_82 = CodeBlock(a=watch_35) { a*0.2; a*0.8; }
# note: Backfill
watch_36 = Watch(code_block_82.out0)
code_block_83 = CodeBlock { "M3"; }
count_12 = List.Count(list=watch_36)
ofRepeatedItem_10 = List.OfRepeatedItem(item=code_block_83, amount=count_12)
code_block_84 = CodeBlock(FuncValues=watch_36, FuncValuesUnit=ofRepeatedItem_10)  # same code as code_block_15
# note: Disposal
watch_37 = Watch(code_block_82.out1)
code_block_85 = CodeBlock { "M3"; }
count_13 = List.Count(list=watch_37)
ofRepeatedItem_11 = List.OfRepeatedItem(item=code_block_85, amount=count_13)
code_block_86 = CodeBlock(FuncValues=watch_37, FuncValuesUnit=ofRepeatedItem_11)  # same code as code_block_15

watch_38 = Watch(code_block_84)
watch_39 = Watch(code_block_86)

# group: <Func 4> 콘크리트 체적의 0.1(ton)
watch_40 = Watch(code_block_13)
code_block_87 = CodeBlock(a=watch_40) { a*0.1; }
watch_41 = Watch(code_block_87)
code_block_88 = CodeBlock { "ton"; }
count_14 = List.Count(list=watch_41)
ofRepeatedItem_12 = List.OfRepeatedItem(item=code_block_88, amount=count_14)
code_block_89 = CodeBlock(FuncValues=watch_41, FuncValuesUnit=ofRepeatedItem_12)  # same code as code_block_15

watch_42 = Watch(code_block_89)
watch_43 = Watch(code_block_81)

# group: Railings
code_block_90 = CodeBlock {  }
code_block_91 = CodeBlock {  }

# group: Furniture
code_block_92 = CodeBlock {  }
code_block_93 = CodeBlock {  }

# group: Primary Input
categories_3 = Categories("OST_Furniture")
all_elements_of_category_3 = ElementsOfCategory(Category=categories_3)
file_path_3 = Filename(".\BIM_물량집계 자동화 산출기준표_rC(20210729).xlsx")
file_from_path_3 = FileObject(path=file_path_3)
code_block_94 = CodeBlock { "Furniture"; }

# group: GetFull WMCodeDescription PerElement
getFullWMCodeDescriptionPerElement_3 = Custom[GetFullWMCodeDescriptionPerElement](InputElement=all_elements_of_category_3, InputFilePath=file_from_path_3, InputSheetName=code_block_94)  # frozen

# group: OrganizeAllElementInformAsDictionary
organizeAllElementInformAsDictionary_3 = Custom[OrganizeAllElementInformAsDictionary](InputDic=getFullWMCodeDescriptionPerElement_3.Dictionary)

# group: Select Target Family Element And Connected WorkMasters
code_block_95 = CodeBlock { [0,1]; }
selectTargetFamilyInformAsDictionary_3 = Custom[SelectTargetFamilyInformAsDictionary](InputDic=organizeAllElementInformAsDictionary_3, InputIndex=code_block_95)

watch_44 = Watch(selectTargetFamilyInformAsDictionary_3)
code_block_96 = CodeBlock(i=watch_44) { i; }

# group: <Func 1> 길이합계 (Top Rails 길이 산출)
code_block_97 = CodeBlock { "Length"; }
getParameterValueByName_2 = Element.GetParameterValueByName(parameterName=code_block_97)  # unwired: element
code_block_98 = CodeBlock { "TargetElements"; }
valueAtKey_14 = DesignScript.Builtin.Dictionary.ValueAtKey(dictionary=code_block_96, key=code_block_98)

geometry_7 = Element.Geometry(element=valueAtKey_14)
count_15 = List.Count(list=valueAtKey_14@L2)

# group: Ramp
code_block_99 = CodeBlock {  }
code_block_100 = CodeBlock {  }

# group: Primary Input
categories_4 = Categories("OST_StructuralFoundation")
all_elements_of_category_4 = ElementsOfCategory(Category=categories_4)
file_path_4 = Filename(".\BIM_물량집계 자동화 산출기준표_rC(20210729).xlsx")
file_from_path_4 = FileObject(path=file_path_4)
code_block_101 = CodeBlock { "Ramp"; }

# group: GetFull WMCodeDescription PerElement
getFullWMCodeDescriptionPerElement_4 = Custom[GetFullWMCodeDescriptionPerElement](InputElement=all_elements_of_category_4, InputFilePath=file_from_path_4, InputSheetName=code_block_101)  # frozen

# group: OrganizeAllElementInformAsDictionary
organizeAllElementInformAsDictionary_4 = Custom[OrganizeAllElementInformAsDictionary](InputDic=getFullWMCodeDescriptionPerElement_4.Dictionary)

# group: Select Target Family Element And Connected WorkMasters
code_block_102 = CodeBlock { 6; }
selectTargetFamilyInformAsDictionary_4 = Custom[SelectTargetFamilyInformAsDictionary](InputDic=organizeAllElementInformAsDictionary_4, InputIndex=code_block_102)

watch_45 = Watch(selectTargetFamilyInformAsDictionary_4)
code_block_103 = CodeBlock(i=watch_45) { i; }
code_block_104 = CodeBlock { "TargetElements"; }
valueAtKey_15 = DesignScript.Builtin.Dictionary.ValueAtKey(dictionary=code_block_103, key=code_block_104)
geometry_8 = Element.Geometry(element=valueAtKey_15)
flatten_40 = List.Flatten(list=geometry_8)

# group: <Func 1> 콘크리트 체적
volume_3 = Solid.Volume(solid=flatten_40)
flatten_41 = List.Flatten(list=volume_3)
sum_8 = Math.Sum(values=flatten_41)
code_block_105 = CodeBlock(i=sum_8) { Math.Round(List.Flatten(i)/1000000000, 2); }
code_block_106 = CodeBlock { "M3"; }
count_16 = List.Count(list=code_block_105)
ofRepeatedItem_13 = List.OfRepeatedItem(item=code_block_106, amount=count_16)
code_block_107 = CodeBlock(FuncValues=code_block_105, FuncValuesUnit=ofRepeatedItem_13)  # same code as code_block_15
flatten_42 = List.Flatten()  # unwired: list

watch_46 = Watch(code_block_107)

# group: <Func 2> 콘크리트 체적의 0.1(ton)
watch_47 = Watch(code_block_105)
code_block_108 = CodeBlock(a=watch_47) { a*0.1; }
watch_48 = Watch(code_block_108)
code_block_109 = CodeBlock { "ton"; }
count_17 = List.Count(list=watch_48)
ofRepeatedItem_14 = List.OfRepeatedItem(item=code_block_109, amount=count_17)
code_block_110 = CodeBlock(FuncValues=watch_48, FuncValuesUnit=ofRepeatedItem_14)  # same code as code_block_15

watch_49 = Watch(code_block_110)
origin = Point.Origin()
levels = Levels("G.L")
elevation = Level.Elevation(level=levels)
translate_3 = Geometry.Translate(geometry=origin, zTranslation=elevation)
ZAxis = Vector.ZAxis()
byOriginNormal = Plane.ByOriginNormal(origin=translate_3, normal=ZAxis)
split = Geometry.Split(geometry=flatten_40, other=byOriginNormal)
flatten_43 = List.Flatten(list=split)
centroid = Solid.Centroid()  # unwired: solid
Z_3 = Point.Z(point=centroid)
minimumItemByKey_4 = List.MinimumItemByKey(list=flatten_43, keyFunction=Z_3)

# group: <Func 3> 터파기 물량 콘크리트 체적의 1.2
volume_4 = Solid.Volume(solid=minimumItemByKey_4)
flatten_44 = List.Flatten(list=volume_4)
sum_9 = Math.Sum(values=flatten_44)
code_block_111 = CodeBlock(i=sum_9) { Math.Round(List.Flatten(i)/1000000000, 2); }
code_block_112 = CodeBlock(a=code_block_111) { a*1.2; }
code_block_113 = CodeBlock { "M3"; }
count_18 = List.Count(list=code_block_112)
ofRepeatedItem_15 = List.OfRepeatedItem(item=code_block_113, amount=count_18)
code_block_114 = CodeBlock(FuncValues=code_block_112, FuncValuesUnit=ofRepeatedItem_15)  # same code as code_block_15

watch_50 = Watch(code_block_114)

# group: <Func 4> Excavation 물량에 20% , Excavation 물량에 80%
watch_51 = Watch(code_block_112)
code_block_115 = CodeBlock(a=watch_51) { a*0.2; a*0.8; }
# note: Backfill
watch_52 = Watch(code_block_115.out0)
code_block_116 = CodeBlock { "M3"; }
count_19 = List.Count(list=watch_52)
ofRepeatedItem_16 = List.OfRepeatedItem(item=code_block_116, amount=count_19)
code_block_117 = CodeBlock(FuncValues=watch_52, FuncValuesUnit=ofRepeatedItem_16)  # same code as code_block_15
# note: Disposal
watch_53 = Watch(code_block_115.out1)
code_block_118 = CodeBlock { "M3"; }
count_20 = List.Count(list=watch_53)
ofRepeatedItem_17 = List.OfRepeatedItem(item=code_block_118, amount=count_20)
code_block_119 = CodeBlock(FuncValues=watch_53, FuncValuesUnit=ofRepeatedItem_17)  # same code as code_block_15

watch_54 = Watch(code_block_117)
watch_55 = Watch(code_block_119)
watch_56 = Watch(geometry_2)
flatten_45 = List.Flatten(list=watch_56)
explode_8 = Geometry.Explode(geometry=flatten_45)
code_block_120 = CodeBlock { 150000; }
area_11 = Surface.Area(surface=explode_8)
round_6 = Math.Round(number=area_11)
gt_5 = code_block_120 > round_6
filterByBoolMask_18 = List.FilterByBoolMask(list=explode_8, mask=gt_5)
flatten_46 = List.Flatten(list=filterByBoolMask_18.in)
uniqueItems_5 = List.UniqueItems(list=round_6)
watch_57 = Watch(filterByBoolMask_18.in)
perimeterCurves_7 = Surface.PerimeterCurves(surface=watch_57)
code_block_121 = CodeBlock { 0.5; }
pointAtParameter_4 = Surface.PointAtParameter(surface=watch_57, u=code_block_121, v=code_block_121)
startPoint_8 = Curve.StartPoint(curve=perimeterCurves_7)
byStartPointEndPoint_4 = Line.ByStartPointEndPoint(startPoint=pointAtParameter_4, endPoint=startPoint_8)
length_5 = Curve.Length()  # unwired: curve
minimumItemByKey_5 = List.MinimumItemByKey(list=byStartPointEndPoint_4@L2, keyFunction=length_5)
count_21 = List.Count(list=byStartPointEndPoint_4)
chop_4 = List.Chop(list=minimumItemByKey_5, lengths=count_21)
doesIntersect_11 = Geometry.DoesIntersect(geometry=chop_4@L2, other=perimeterCurves_7@L3)
filterByBoolMask_19 = List.FilterByBoolMask(list=perimeterCurves_7@L3, mask=doesIntersect_11@L3)
flatten_47 = List.Flatten(list=filterByBoolMask_19.in)
watch_58 = Watch(flatten_47)
code_block_122 = CodeBlock { 2; }
dropItems_5 = List.DropItems(list=watch_58, amount=code_block_122)
endPoint_4 = Curve.EndPoint(curve=dropItems_5)
code_block_123 = CodeBlock { -1; }
dropItems_6 = List.DropItems(list=endPoint_4, amount=code_block_123)
startPoint_9 = Curve.StartPoint(curve=dropItems_5)
join_5 = List.Join(list0=dropItems_6, list1=startPoint_9)
byPoints_7 = PolyCurve.ByPoints(points=join_5)
watch_59 = Watch(filterByBoolMask_19.in)
