# Dynamo graph Str Foundation Calculator_DataStructureTest(1006)_mk.dyn (Dynamo 2.10.1.3976)

# note: 되메우기기

# group: Example
code_block = CodeBlock { ["a","b","c"]; [1,2,3]; }
byKeysValues = DesignScript.Builtin.Dictionary.ByKeysValues(keys=code_block.out0, values=code_block.out1)
code_block_2 = CodeBlock { ["d","e","f"]; [4,5,6]; }
byKeysValues_2 = DesignScript.Builtin.Dictionary.ByKeysValues(keys=code_block_2.out0, values=code_block_2.out1)
code_block_3 = CodeBlock(a1=byKeysValues, b1=byKeysValues_2)
# ---------- code_block_3.designscript (4 lines) ----------
{
"a1": a1
,"b1": b1
};
# ----------------------------------------
code_block_4 = CodeBlock { "a1"; }
valueAtKey = DesignScript.Builtin.Dictionary.ValueAtKey(dictionary=code_block_3, key=code_block_4)
code_block_5 = CodeBlock { "a"; }
valueAtKey_2 = DesignScript.Builtin.Dictionary.ValueAtKey(dictionary=valueAtKey, key=code_block_5)

# group: Primary Input
categories = Categories("OST_StructuralFoundation")
all_elements_of_category = ElementsOfCategory(Category=categories)
file_path = Filename("..\Laboratory\20210928_kcs 에러\BIM_물량집계 자동화 산출기준표_rC(20210903).xlsx")
file_from_path = FileObject(path=file_path)
code_block_6 = CodeBlock { "Str Foundations"; }

# group: GetFull WMCodeDescription PerElement
getFullWMCodeDescriptionPerElement = Custom[GetFullWMCodeDescriptionPerElement](InputElement=all_elements_of_category, InputFilePath=file_from_path, InputSheetName=code_block_6)  # GetFullWMCodeDescriptionPerElement

# group: OrganizeAllElementInformAsDictionary
organizeAllElementInformAsDictionary = Custom[OrganizeAllElementInformAsDictionary](InputDic=getFullWMCodeDescriptionPerElement.Dictionary)  # OrganizeAllElementInformAsDictionary

# group: Select Target Family Element And Connected WorkMasters
code_block_7 = CodeBlock { 1; }
selectTargetFamilyInformAsDictionary = Custom[SelectTargetFamilyInformAsDictionary](InputDic=organizeAllElementInformAsDictionary, InputIndex=code_block_7)  # Select Target Family Element And Connected WorkMasters

# group: Distributer
code_block_8 = CodeBlock(i=selectTargetFamilyInformAsDictionary) { i; }  # frozen
code_block_9 = CodeBlock(i=code_block_8) { i; }
code_block_10 = CodeBlock(i=code_block_9) { i; }
code_block_11 = CodeBlock(i=code_block_9) { i; }
code_block_12 = CodeBlock(i=code_block_8) { i; }
code_block_13 = CodeBlock(i=code_block_12) { i; }
code_block_14 = CodeBlock(i=code_block_8) { i; }
code_block_15 = CodeBlock(i=code_block_14) { i; }
code_block_16 = CodeBlock(i=code_block_8) { i; }
code_block_17 = CodeBlock(i=code_block_16) { i; }
code_block_18 = CodeBlock(i=code_block_9) { i; }
code_block_19 = CodeBlock(i=code_block_14) { i; }
code_block_20 = CodeBlock(i=code_block_14) { i; }
code_block_21 = CodeBlock(i=code_block_16) { i; }
code_block_22 = CodeBlock(i=code_block_16) { i; }
code_block_23 = CodeBlock(i=code_block_12) { i; }

code_block_24 = CodeBlock { "TargetElements"; }
valueAtKey_3 = DesignScript.Builtin.Dictionary.ValueAtKey(dictionary=code_block_10, key=code_block_24)
# note: <Func>
extractUpperFacesOfElement = Custom[ExtractUpperFacesOfElement](Element=valueAtKey_3)  # ExtractUpperFacesOfElement

# group: <Func 2> - 수정필요
code_block_25 = CodeBlock { "TargetElements"; }
valueAtKey_4 = DesignScript.Builtin.Dictionary.ValueAtKey(dictionary=code_block_11, key=code_block_25)
# note: <Func>
extractSideFacesOfElement = Custom[ExtractSideFacesOfElement](Element=valueAtKey_4)  # ExtractSideFacesOfElement
area = Surface.Area(surface=extractSideFacesOfElement.Surface)
sum = Math.Sum(values=area)
code_block_26 = CodeBlock(i=sum) { Math.Round(List.Flatten(i)/1000000, 2); }
code_block_27 = CodeBlock { "M2"; }
count = List.Count(list=code_block_26)
ofRepeatedItem = List.OfRepeatedItem(item=code_block_27, amount=count)
code_block_28 = CodeBlock(FuncValues=code_block_26, FuncValuesUnit=ofRepeatedItem)
# ---------- code_block_28.designscript (4 lines) ----------
{
"FuncValues": _FuncValues,
"FuncValuesUnit": _FuncValuesUnit
};
# ----------------------------------------

code_block_29 = CodeBlock { "TargetElements"; }
valueAtKey_5 = DesignScript.Builtin.Dictionary.ValueAtKey(dictionary=code_block_13, key=code_block_29)
code_block_30 = CodeBlock { 0; 100; }
createLeanConcrete = Custom[CreateLeanConcrete](Element=valueAtKey_5, leanOffset=code_block_30.out0, leanThick=code_block_30.out1)  # CreateLeanConcreteForISOFDN
code_block_31 = CodeBlock { "TargetElements"; }
valueAtKey_6 = DesignScript.Builtin.Dictionary.ValueAtKey(dictionary=code_block_15, key=code_block_31)
code_block_32 = CodeBlock { 0; }
createExcavationSolid = Custom[CreateExcavationSolid](Element=valueAtKey_6, ExcavOffsetTop=code_block_32, ExcavOffsetBottom=code_block_32)  # CreateExcavationSolidForISOFDN
code_block_33 = CodeBlock { "TargetElements"; }
valueAtKey_7 = DesignScript.Builtin.Dictionary.ValueAtKey(dictionary=code_block_17, key=code_block_33)
createBaseCourseSurfaces = Custom[CreateBaseCourseSurfaces](Element=valueAtKey_7)  # CreateBaseCourseSurfaces

# group: See Result
code_block_34 = CodeBlock(SeeResult=extractUpperFacesOfElement.GeometryColor) { SeeResult; }
code_block_35 = CodeBlock(SeeResult=extractSideFacesOfElement.GeometryColor) { SeeResult; }
code_block_36 = CodeBlock(SeeResult=createLeanConcrete.GeometryColor) { SeeResult; }
code_block_37 = CodeBlock(SeeResult=createExcavationSolid.GeometryColor) { SeeResult; }
code_block_38 = CodeBlock(SeeResult=createBaseCourseSurfaces.GeometryColor) { SeeResult; }

# group: Select Target Family Element And Connected WorkMasters
code_block_39 = CodeBlock { 2; }
selectTargetFamilyInformAsDictionary_2 = Custom[SelectTargetFamilyInformAsDictionary](InputDic=organizeAllElementInformAsDictionary, InputIndex=code_block_39)

# group: Distributer
code_block_40 = CodeBlock(i=selectTargetFamilyInformAsDictionary_2) { i; }  # frozen
code_block_41 = CodeBlock(i=code_block_40) { i; }
code_block_42 = CodeBlock(i=code_block_41) { i; }
code_block_43 = CodeBlock(i=code_block_41) { i; }
code_block_44 = CodeBlock(i=code_block_40) { i; }
code_block_45 = CodeBlock(i=code_block_44) { i; }
code_block_46 = CodeBlock(i=code_block_40) { i; }
code_block_47 = CodeBlock(i=code_block_46) { i; }
code_block_48 = CodeBlock(i=code_block_40) { i; }
code_block_49 = CodeBlock(i=code_block_48) { i; }
code_block_50 = CodeBlock(i=code_block_41) { i; }
code_block_51 = CodeBlock(i=code_block_46) { i; }
code_block_52 = CodeBlock(i=code_block_46) { i; }
code_block_53 = CodeBlock(i=code_block_48) { i; }
code_block_54 = CodeBlock(i=code_block_48) { i; }
code_block_55 = CodeBlock(i=code_block_44) { i; }

code_block_56 = CodeBlock { "TargetElements"; }
valueAtKey_8 = DesignScript.Builtin.Dictionary.ValueAtKey(dictionary=code_block_42, key=code_block_56)
extractUpperFacesOfElement_2 = Custom[ExtractUpperFacesOfElement](Element=valueAtKey_8)

# group: <Func 2> - 수정필요
code_block_57 = CodeBlock { "TargetElements"; }
valueAtKey_9 = DesignScript.Builtin.Dictionary.ValueAtKey(dictionary=code_block_43, key=code_block_57)
# note: <Func>
extractSideFacesOfElement_2 = Custom[ExtractSideFacesOfElement](Element=valueAtKey_9)
area_2 = Surface.Area(surface=extractSideFacesOfElement_2.Surface)
sum_2 = Math.Sum(values=area_2)
code_block_58 = CodeBlock(i=sum_2) { Math.Round(List.Flatten(i)/1000000, 2); }
code_block_59 = CodeBlock { "M2"; }
count_2 = List.Count(list=code_block_58)
ofRepeatedItem_2 = List.OfRepeatedItem(item=code_block_59, amount=count_2)
code_block_60 = CodeBlock(FuncValues=code_block_58, FuncValuesUnit=ofRepeatedItem_2)  # same code as code_block_28

code_block_61 = CodeBlock { "TargetElements"; }
valueAtKey_10 = DesignScript.Builtin.Dictionary.ValueAtKey(dictionary=code_block_45, key=code_block_61)
code_block_62 = CodeBlock { 0; 100; }
createLeanConcrete_2 = Custom[CreateLeanConcrete](Element=valueAtKey_10, leanOffset=code_block_62.out0, leanThick=code_block_62.out1)
code_block_63 = CodeBlock { "TargetElements"; }
valueAtKey_11 = DesignScript.Builtin.Dictionary.ValueAtKey(dictionary=code_block_47, key=code_block_63)
code_block_64 = CodeBlock { 0; }
createExcavationSolid_2 = Custom[CreateExcavationSolid](Element=valueAtKey_11, ExcavOffsetTop=code_block_64, ExcavOffsetBottom=code_block_64)
code_block_65 = CodeBlock { "TargetElements"; }
valueAtKey_12 = DesignScript.Builtin.Dictionary.ValueAtKey(dictionary=code_block_49, key=code_block_65)
createBaseCourseSurfaces_2 = Custom[CreateBaseCourseSurfaces](Element=valueAtKey_12)

# group: See Result
code_block_66 = CodeBlock(SeeResult=extractUpperFacesOfElement_2.GeometryColor) { SeeResult; }
code_block_67 = CodeBlock(SeeResult=extractSideFacesOfElement_2.GeometryColor) { SeeResult; }
code_block_68 = CodeBlock(SeeResult=createLeanConcrete_2.GeometryColor) { SeeResult; }
code_block_69 = CodeBlock(SeeResult=createExcavationSolid_2.GeometryColor) { SeeResult; }
code_block_70 = CodeBlock(SeeResult=createBaseCourseSurfaces_2.GeometryColor) { SeeResult; }

# group: Select Target Family Element And Connected WorkMasters
code_block_71 = CodeBlock { 0; }
selectTargetFamilyInformAsDictionary_3 = Custom[SelectTargetFamilyInformAsDictionary](InputDic=organizeAllElementInformAsDictionary, InputIndex=code_block_71)

# group: <Func 0> Input Manager
value_for_import_from_others = CodeBlock(MainInput=selectTargetFamilyInformAsDictionary_3) { MainInput; RefInput; }  # unwired: RefInput

# group: <Func 0> Structural Concrete
code_block_72 = CodeBlock { "TargetElements"; }
valueAtKey_13 = DesignScript.Builtin.Dictionary.ValueAtKey(dictionary=value_for_import_from_others.MainInput, key=code_block_72)
code_block_73 = CodeBlock { "Volume"; }
# note: <Func>
getParameterValueByName = Element.GetParameterValueByName(element=valueAtKey_13, parameterName=code_block_73)
code_block_74 = CodeBlock(i=getParameterValueByName) { Math.Round(List.Flatten(i)/1, 2); }
code_block_75 = CodeBlock { "M3"; }
count_3 = List.Count(list=code_block_74)
ofRepeatedItem_3 = List.OfRepeatedItem(item=code_block_75, amount=count_3)
code_block_76 = CodeBlock(FuncValues=code_block_74, FuncValuesUnit=ofRepeatedItem_3)  # same code as code_block_28

# group: <Func 0> Output Manager
output = CodeBlock(MainOutput=code_block_76) { MainOutput; RefOutput1; RefOutput2; }  # unwired: RefOutput1, RefOutput2
reference_output = CodeBlock { ref; }  # unwired: ref

# group: <Func 5> Input Manager
value_for_import_from_others_2 = CodeBlock(MainInput=selectTargetFamilyInformAsDictionary_3) { MainInput; RefInput; }  # unwired: RefInput

# group: <Func 5> Lean Concrete
code_block_77 = CodeBlock { "TargetElements"; }
valueAtKey_14 = DesignScript.Builtin.Dictionary.ValueAtKey(dictionary=value_for_import_from_others_2.MainInput, key=code_block_77)
# note: <Func>
createLeanConcrete_3 = Custom[CreateLeanConcrete](Element=valueAtKey_14)
flatten = List.Flatten(list=createLeanConcrete_3.Solid)
value_for_export_to_others = CodeBlock(린콘크리트형상=flatten) { 린콘크리트형상; }
volume = Solid.Volume(solid=createLeanConcrete_3.Solid)
code_block_78 = CodeBlock(i=volume) { Math.Round(List.Flatten(i)/1000000000, 2); }
code_block_79 = CodeBlock { "M3"; }
count_4 = List.Count(list=code_block_78)
ofRepeatedItem_4 = List.OfRepeatedItem(item=code_block_79, amount=count_4)
code_block_80 = CodeBlock(FuncValues=code_block_78, FuncValuesUnit=ofRepeatedItem_4)  # same code as code_block_28

# group: <Func 5> Output Manager
reference_output_2 = CodeBlock(ref=value_for_export_to_others) { ref; }
output_2 = CodeBlock(MainOutput=code_block_80, RefOutput_geoColor=createLeanConcrete_3.GeometryColor) { MainOutput; RefOutput_geoColor; }

# group: <Func 1> Input Manager
value_for_import_from_others_3 = CodeBlock(MainInput=selectTargetFamilyInformAsDictionary_3, RefInput=reference_output_2) { MainInput; RefInput; }

# group: <Func 1-1> Excavation by IsoFDN
하부_surface_추출 = Python(IN[0]=value_for_import_from_others_3.RefInput)  # CPython3
# ---------- 하부_surface_추출.python (26 lines) ----------
# Load the Python Standard and DesignScript Libraries
import sys
import clr
import itertools
clr.AddReference('ProtoGeometry')
from Autodesk.DesignScript.Geometry import *

# The inputs to this node will be stored as a list in the IN variables.
dataEnteringNode = IN
input_elements = IN[0]

# Place your code below this line

srfs_input_elements = list(map(lambda x: x.Explode(), input_elements))

#srfs_input_flatten = list(itertools.chain(*srfs_input_elements))

def func_findZ_normalAtParma(srf):
    return srf.NormalAtParameter(0.5,0.5).Z
srfs_below = list(map(lambda y: filter(lambda x: func_findZ_normalAtParma(x) == -1, y), srfs_input_elements))

result = srfs_below


# Assign your output to the OUT variable.
OUT = result
# ----------------------------------------
flatten_2 = List.Flatten(list=하부_surface_추출)
perimeterCurves = Surface.PerimeterCurves(surface=flatten_2)
byJoinedCurves = PolyCurve.ByJoinedCurves(curves=perimeterCurves)
code_block_81 = CodeBlock { _ExcavOffsetBottom: var[]..[] = 300; }
offset = Curve.Offset(curve=byJoinedCurves, distance=code_block_81)
flatten_3 = List.Flatten(list=offset)
levels = Levels("G.L")  # graph input
elevation = Level.Elevation(level=levels)
code_block_82 = CodeBlock { "TargetElements"; }
valueAtKey_15 = DesignScript.Builtin.Dictionary.ValueAtKey(dictionary=value_for_import_from_others_3.MainInput, key=code_block_82)
code_block_83 = CodeBlock { "Elevation at Bottom"; }
getParameterValueByName_2 = Element.GetParameterValueByName(element=valueAtKey_15, parameterName=code_block_83)
린_콘크리트_하부까지의_길이_추출_최하단 = Python(IN[0]=value_for_import_from_others_3.RefInput)  # CPython3
# ---------- 린_콘크리트_하부까지의_길이_추출_최하단.python (22 lines) ----------
# Load the Python Standard and DesignScript Libraries
import sys
import clr
clr.AddReference('ProtoGeometry')
from Autodesk.DesignScript.Geometry import *

# The inputs to this node will be stored as a list in the IN variables.
dataEnteringNode = IN
inputs = IN[0]

# Place your code below this line

def findThickness(i):
    minPt_Z = BoundingBox.ByGeometry(i).MinPoint.Z
    maxPt_Z = BoundingBox.ByGeometry(i).MaxPoint.Z
    result = maxPt_Z - minPt_Z
    return result

thicknessByInput = list(map(findThickness, inputs))

# Assign your output to the OUT variable.
OUT = thicknessByInput
# ----------------------------------------
code_block_84 = CodeBlock(기초하단=getParameterValueByName_2, 린콘크리트하단=린_콘크리트_하부까지의_길이_추출_최하단) { 기초하단-린콘크리트하단; }
sub = elevation - code_block_84
code_block_85 = CodeBlock { 0; }
isNull = Object.IsNull()  # unwired: object
replaceByCondition = Replace(item=sub, replaceWith=code_block_85, condition=isNull)
flatten_4 = List.Flatten(list=replaceByCondition)
translate = Geometry.Translate(geometry=offset, zTranslation=flatten_4)
경사_비율_입력_1_x_for_isofdn = DoubleInput(2)  # graph input
code_block_86 = CodeBlock(ElevationatBottom=flatten_4, 비율=경사_비율_입력_1_x_for_isofdn) { ElevationatBottom/비율; }
offset_2 = Curve.Offset(curve=translate, distance=code_block_86)
flatten_5 = List.Flatten(list=offset_2)
list_create = List.Create(item0=flatten_3, item1=flatten_5)
transpose = List.Transpose(lists=list_create)
byLoft = Solid.ByLoft(crossSections=transpose)
터파기_형상_겹침_해소 = Python(IN[0]=byLoft)  # CPython3
# ---------- 터파기_형상_겹침_해소.python (29 lines) ----------
# Load the Python Standard and DesignScript Libraries
import sys
import clr
clr.AddReference('ProtoGeometry')
from Autodesk.DesignScript.Geometry import *

# The inputs to this node will be stored as a list in the IN variables.
dataEnteringNode = IN
inputs = IN[0]
result = []
# Place your code below this line

for x in range(len(inputs)):
    if x < len(inputs)-1:
        temp = []
        apply = inputs[x]
        for y in range(x,len(inputs)):
            if apply.DoesIntersect(inputs[y]):
                apply = apply.Split(inputs[y])[0]
                temp.append(apply)
            else:
                apply = apply
                temp.append(apply)
        result.append(temp[-1])
    elif x == len(inputs)-1:
        result.append(inputs[x])

# Assign your output to the OUT variable.
OUT = result
# ----------------------------------------
volume_2 = Solid.Volume(solid=터파기_형상_겹침_해소)
code_block_87 = CodeBlock(i=volume_2) { Math.Round(List.Flatten(i)/1000000000, 2); }
code_block_88 = CodeBlock { "M3"; }
count_5 = List.Count(list=code_block_87)
ofRepeatedItem_5 = List.OfRepeatedItem(item=code_block_88, amount=count_5)
code_block_89 = CodeBlock(FuncValues=code_block_87, FuncValuesUnit=ofRepeatedItem_5)  # same code as code_block_28
color_palette = ColorPalette({R: 210, G: 105, B: 30, A: 135})
byGeometryColor = Modifiers.GeometryColor.ByGeometryColor(geometry=터파기_형상_겹침_해소, color=color_palette)
forRefOutput = CodeBlock(MainOutput=code_block_89, geoColor=byGeometryColor, 터파기형상=터파기_형상_겹침_해소)
# ---------- forRefOutput.designscript (5 lines) ----------
{
"MainOutput": MainOutput,
"geoColor": geoColor,
"터파기형상": 터파기형상
};
# ----------------------------------------

# group: <Func 1-2> Excavation by Overall
하부_surface_추출_2 = Python(IN[0]=value_for_import_from_others_3.RefInput)  # CPython3; same code as 하부_surface_추출
flatten_6 = List.Flatten(list=하부_surface_추출_2)
byGeometry = BoundingBox.ByGeometry(geom=flatten_6)
toCuboid = BoundingBox.ToCuboid(boundingBox=byGeometry)
code_block_90 = CodeBlock(i=toCuboid) { [i]; }
하부_surface_추출_3 = Python(IN[0]=code_block_90)  # CPython3; same code as 하부_surface_추출
perimeterCurves_2 = Surface.PerimeterCurves(surface=하부_surface_추출_3)
byJoinedCurves_2 = PolyCurve.ByJoinedCurves(curves=perimeterCurves_2)
code_block_91 = CodeBlock { _ExcavOffsetBottom: var[]..[] = 300; }
offset_3 = Curve.Offset(curve=byJoinedCurves_2, distance=code_block_91)
flatten_7 = List.Flatten(list=offset_3)
levels_2 = Levels("G.L")  # graph input
elevation_2 = Level.Elevation(level=levels_2)
code_block_92 = CodeBlock { "TargetElements"; }
valueAtKey_16 = DesignScript.Builtin.Dictionary.ValueAtKey(dictionary=value_for_import_from_others_3.MainInput, key=code_block_92)
code_block_93 = CodeBlock { "Elevation at Bottom"; }
getParameterValueByName_3 = Element.GetParameterValueByName(element=valueAtKey_16, parameterName=code_block_93)
린_콘크리트_하부까지의_길이_추출_최하단_2 = Python(IN[0]=value_for_import_from_others_3.RefInput)  # CPython3; same code as 린_콘크리트_하부까지의_길이_추출_최하단
code_block_94 = CodeBlock(기초하단=getParameterValueByName_3, 린콘크리트하단=린_콘크리트_하부까지의_길이_추출_최하단_2) { 기초하단-린콘크리트하단; }
uniqueItems = List.UniqueItems(list=code_block_94@L2)
sub_2 = elevation_2 - uniqueItems
code_block_95 = CodeBlock { 0; }
isNull_2 = Object.IsNull()  # unwired: object
replaceByCondition_2 = Replace(item=sub_2, replaceWith=code_block_95, condition=isNull_2)
flatten_8 = List.Flatten(list=replaceByCondition_2)
translate_2 = Geometry.Translate(geometry=offset_3, zTranslation=flatten_8)
경사_비율_입력_1_x_for_overall = DoubleInput(2)  # graph input
code_block_96 = CodeBlock(ElevationatBottom=flatten_8, 비율=경사_비율_입력_1_x_for_overall) { ElevationatBottom/비율; }
offset_4 = Curve.Offset(curve=translate_2, distance=code_block_96)
flatten_9 = List.Flatten(list=offset_4)
list_create_2 = List.Create(item0=flatten_7, item1=flatten_9)
transpose_2 = List.Transpose(lists=list_create_2)
byLoft_2 = Solid.ByLoft(crossSections=transpose_2)
터파기_형상_겹침_해소_2 = Python(IN[0]=byLoft_2)  # CPython3; same code as 터파기_형상_겹침_해소
volume_3 = Solid.Volume(solid=터파기_형상_겹침_해소_2)
code_block_97 = CodeBlock(i=volume_3) { Math.Round(List.Flatten(i)/1000000000, 2); }
code_block_98 = CodeBlock { "M3"; }
count_6 = List.Count(list=code_block_97)
ofRepeatedItem_6 = List.OfRepeatedItem(item=code_block_98, amount=count_6)
code_block_99 = CodeBlock(FuncValues=code_block_97, FuncValuesUnit=ofRepeatedItem_6)  # same code as code_block_28
color_palette_2 = ColorPalette({R: 210, G: 105, B: 30, A: 135})
byGeometryColor_2 = Modifiers.GeometryColor.ByGeometryColor(geometry=터파기_형상_겹침_해소_2, color=color_palette_2)
forRefOutput_2 = CodeBlock(MainOutput=code_block_99, geoColor=byGeometryColor_2, 터파기형상=터파기_형상_겹침_해소_2)  # same code as forRefOutput

# group: 함수 선택
터파기_산출_타입_선택_iso_or_overall = StringInput("iso")  # graph input
code_block_100 = CodeBlock(functionName=터파기_산출_타입_선택_iso_or_overall) { functionName == "iso"? true:false; }
if_ = If(test=code_block_100, true=forRefOutput, false=forRefOutput_2)

# group: <Func 1> Output Manager
code_block_101 = CodeBlock { "MainOutput"; }
valueAtKey_17 = DesignScript.Builtin.Dictionary.ValueAtKey(dictionary=if_, key=code_block_101)
code_block_102 = CodeBlock { "geoColor"; }
valueAtKey_18 = DesignScript.Builtin.Dictionary.ValueAtKey(dictionary=if_, key=code_block_102)
output_3 = CodeBlock(MainOutput=valueAtKey_17, RefOutput_geoColor=valueAtKey_18) { MainOutput; RefOutput_geoColor; }
code_block_103 = CodeBlock { "터파기형상"; }
valueAtKey_19 = DesignScript.Builtin.Dictionary.ValueAtKey(dictionary=if_, key=code_block_103)
reference_output_3 = CodeBlock(터파기형상=valueAtKey_19) { 터파기형상; }

# group: <Func 2> Input Manager
value_for_import_from_others_4 = CodeBlock(MainInput=selectTargetFamilyInformAsDictionary_3, RefInput1=reference_output_3, RefInput2=reference_output_2) { MainInput; RefInput1; RefInput2; }

# group: <Func 2> Backfill
value_for_import_from_others_5 = CodeBlock(터파기형상=value_for_import_from_others_4.RefInput1) { 터파기형상; }
flatten_10 = List.Flatten(list=value_for_import_from_others_5)
volume_4 = Solid.Volume(solid=flatten_10)
flatten_11 = List.Flatten(list=value_for_import_from_others_4.RefInput2)
code_block_104 = CodeBlock { "TargetElements"; }
valueAtKey_20 = DesignScript.Builtin.Dictionary.ValueAtKey(dictionary=value_for_import_from_others_4.MainInput, key=code_block_104)
geometry = Element.Geometry(element=valueAtKey_20)
flatten_12 = List.Flatten(list=geometry)
categories_2 = Categories("OST_StructuralColumns")
all_elements_of_category_2 = ElementsOfCategory(Category=categories_2)
geometry_2 = Element.Geometry(element=all_elements_of_category_2)
flatten_13 = List.Flatten(list=geometry_2)
doesIntersect = Geometry.DoesIntersect(geometry=flatten_10, other=flatten_13, lacing=CrossProduct)
filterByBoolMask = List.FilterByBoolMask(list=flatten_13, mask=doesIntersect@L2)
flatten_14 = List.Flatten(list=filterByBoolMask.in)
list_create_3 = List.Create(item0=flatten_11, item1=flatten_12, item2=flatten_14)
transpose_3 = List.Transpose(lists=list_create_3)
byUnion = Solid.ByUnion(solids=transpose_3)
volume_5 = Solid.Volume(solid=byUnion)
code_block_105 = CodeBlock(터파기볼륨=volume_4, 콘크리트들볼륨=volume_5) { 터파기볼륨 - 콘크리트들볼륨; }
watch = Watch(code_block_105)
code_block_106 = CodeBlock(i=watch) { Math.Round(List.Flatten(i)/1000000000, 2); }
code_block_107 = CodeBlock { "M3"; }
count_7 = List.Count(list=watch)
ofRepeatedItem_7 = List.OfRepeatedItem(item=code_block_107, amount=count_7)
# note: 터파기 물량ㅈ에서 콘크리트, 린 기둥 물량 빼기
code_block_108 = CodeBlock(FuncValues=code_block_106, FuncValuesUnit=ofRepeatedItem_7)  # same code as code_block_28

# group: <Func 2> Output Manager
output_4 = CodeBlock(MainOutput=code_block_108) { MainOutput; RefOutput_geoColor; }  # unwired: RefOutput_geoColor
reference_output_4 = CodeBlock(콘크리트들볼륨=volume_5) { 콘크리트들볼륨; }

# group: <Func 3> Input Manager
value_for_import_from_others_6 = CodeBlock(MainInput=selectTargetFamilyInformAsDictionary_3, RefInput1=reference_output_4) { MainInput; RefInput1; RefInput2; }  # unwired: RefInput2

# group: <Func 3> Disposal (잔토처리 1.2 비율)
watch_2 = Watch(value_for_import_from_others_6.RefInput1)
토량_환산_계수 = DoubleInput(1)  # graph input
code_block_109 = CodeBlock(i=watch_2, 토량환산계수=토량_환산_계수) { Math.Round(List.Flatten(i)/1000000000, 2)*토량환산계수; }
code_block_110 = CodeBlock { "M3"; }
count_8 = List.Count(list=watch_2)
ofRepeatedItem_8 = List.OfRepeatedItem(item=code_block_110, amount=count_8)
# note: 잔토처리
code_block_111 = CodeBlock(FuncValues=code_block_109, FuncValuesUnit=ofRepeatedItem_8)  # same code as code_block_28

# group: <Func 3> Output Manager
output_5 = CodeBlock(MainOutput=code_block_111) { MainOutput; RefOutput_geoColor; }  # unwired: RefOutput_geoColor
reference_output_5 = CodeBlock { ref; }  # unwired: ref

# group: <Func 4> Input Manager
value_for_import_from_others_7 = CodeBlock(MainInput=selectTargetFamilyInformAsDictionary_3) { MainInput; RefInput1; RefInput2; }  # unwired: RefInput1, RefInput2

# group: <Func 4> Base Course
code_block_112 = CodeBlock { "TargetElements"; }
valueAtKey_21 = DesignScript.Builtin.Dictionary.ValueAtKey(dictionary=value_for_import_from_others_7.MainInput, key=code_block_112)
# note: <Func>
createBaseCourseSurfaces_3 = Custom[CreateBaseCourseSurfaces](Element=valueAtKey_21)
area_3 = Surface.Area(surface=createBaseCourseSurfaces_3.Surface)
code_block_113 = CodeBlock(i=area_3) { Math.Round(List.Flatten(i)/1000000, 2); }
code_block_114 = CodeBlock { "M2"; }
count_9 = List.Count(list=code_block_113)
ofRepeatedItem_9 = List.OfRepeatedItem(item=code_block_114, amount=count_9)
code_block_115 = CodeBlock(FuncValues=code_block_113, FuncValuesUnit=ofRepeatedItem_9)  # same code as code_block_28

# group: <Func 4> Output Manager
output_6 = CodeBlock(MainOutput=code_block_115, RefOutput_geoColor=createBaseCourseSurfaces_3.GeometryColor) { MainOutput; RefOutput_geoColor; }
reference_output_6 = CodeBlock { ref; }  # unwired: ref

# group: <Func 6> Input Manager
value_for_import_from_others_8 = CodeBlock(MainInput=selectTargetFamilyInformAsDictionary_3) { MainInput; RefInput1; RefInput2; }  # unwired: RefInput1, RefInput2

# group: <Func 6> Form Works
code_block_116 = CodeBlock { "TargetElements"; }
valueAtKey_22 = DesignScript.Builtin.Dictionary.ValueAtKey(dictionary=value_for_import_from_others_8.MainInput, key=code_block_116)
# note: <Func>
extractSideFacesOfElement_3 = Custom[ExtractSideFacesOfElement](Element=valueAtKey_22)
area_4 = Surface.Area(surface=extractSideFacesOfElement_3.Surface)
sum_3 = Math.Sum(values=area_4)
code_block_117 = CodeBlock(i=sum_3) { Math.Round(List.Flatten(i)/1000000, 2); }
code_block_118 = CodeBlock { "M2"; }
count_10 = List.Count(list=code_block_117)
ofRepeatedItem_10 = List.OfRepeatedItem(item=code_block_118, amount=count_10)
code_block_119 = CodeBlock(FuncValues=code_block_117, FuncValuesUnit=ofRepeatedItem_10)  # same code as code_block_28

# group: <Func 6> Output Manager
output_7 = CodeBlock(MainOutput=code_block_119, RefOutput_geoColor=extractSideFacesOfElement_3.GeometryColor) { MainOutput; RefOutput_geoColor; }
reference_output_7 = CodeBlock { ref; }  # unwired: ref

# group: <Func 7> Input Manager
value_for_import_from_others_9 = CodeBlock(MainInput=selectTargetFamilyInformAsDictionary_3) { MainInput; RefInput1; RefInput2; }  # unwired: RefInput1, RefInput2

# group: <Func 7> Rebar
code_block_120 = CodeBlock { "TargetElements"; }
valueAtKey_23 = DesignScript.Builtin.Dictionary.ValueAtKey(dictionary=value_for_import_from_others_9.MainInput, key=code_block_120)
code_block_121 = CodeBlock { "Volume"; }
# note: <Func>
getParameterValueByName_4 = Element.GetParameterValueByName(element=valueAtKey_23, parameterName=code_block_121)
철근_비율 = DoubleInput(0)  # graph input
mul = getParameterValueByName_4 * 철근_비율
code_block_122 = CodeBlock(i=mul) { Math.Round(List.Flatten(i)/1, 2); }
code_block_123 = CodeBlock { "TON"; }
count_11 = List.Count(list=code_block_122)
ofRepeatedItem_11 = List.OfRepeatedItem(item=code_block_123, amount=count_11)
code_block_124 = CodeBlock(FuncValues=code_block_122, FuncValuesUnit=ofRepeatedItem_11)  # same code as code_block_28

# group: <Func 7> Output Manager
output_8 = CodeBlock(MainOutput=code_block_124) { MainOutput; RefOutput_geoColor; }  # unwired: RefOutput_geoColor
reference_output_8 = CodeBlock { ref; }  # unwired: ref

# group: <Func 8> Input Manager
value_for_import_from_others_10 = CodeBlock(MainInput=selectTargetFamilyInformAsDictionary_3) { MainInput; RefInput1; RefInput2; }  # unwired: RefInput1, RefInput2

# group: <Func 8> Sheet Memebrane
code_block_125 = CodeBlock { "TargetElements"; }
valueAtKey_24 = DesignScript.Builtin.Dictionary.ValueAtKey(dictionary=value_for_import_from_others_10.MainInput, key=code_block_125)
# note: <Func>
createLeanConcrete_4 = Custom[CreateLeanConcrete](Element=valueAtKey_24)
area_5 = Surface.Area(surface=createLeanConcrete_4.Surface)
code_block_126 = CodeBlock(i=area_5) { Math.Round(List.Flatten(i)/1000000, 2); }
code_block_127 = CodeBlock { "M2"; }
count_12 = List.Count(list=code_block_126)
ofRepeatedItem_12 = List.OfRepeatedItem(item=code_block_127, amount=count_12)
code_block_128 = CodeBlock(FuncValues=code_block_126, FuncValuesUnit=ofRepeatedItem_12)  # same code as code_block_28

# group: <Func 8> Output Manager
output_9 = CodeBlock(MainOutput=code_block_128) { MainOutput; RefOutput_geoColor; }  # unwired: RefOutput_geoColor
reference_output_9 = CodeBlock { ref; }  # unwired: ref

# group: <Func 9> Input Manager
value_for_import_from_others_11 = CodeBlock(MainInput=selectTargetFamilyInformAsDictionary_3) { MainInput; RefInput1; RefInput2; }  # unwired: RefInput1, RefInput2

# group: <Func 9> Membrane Protection Board (측면 + 상부면 중 pedestal 점유면적 제외)
code_block_129 = CodeBlock { "TargetElements"; }
# note: <Func>
valueAtKey_25 = DesignScript.Builtin.Dictionary.ValueAtKey(dictionary=value_for_import_from_others_11.MainInput, key=code_block_129)
code_block_130 = CodeBlock(Element=valueAtKey_25) { _Element; }
extractUpperFacesOfElement_3 = Custom[ExtractUpperFacesOfElement](Element=code_block_130)
flatten_15 = List.Flatten(list=extractUpperFacesOfElement_3.Surface)
getJoinedElements = Element.GetJoinedElements(element=code_block_130)
flatten_16 = List.Flatten(list=getJoinedElements)
extractBelowFacesOfElement = Custom[ExtractBelowFacesOfElement](Element=flatten_16)  # ExtractBelowFacesOfElement
flatten_17 = List.Flatten(list=extractBelowFacesOfElement.Surface)
doesIntersect_2 = Geometry.DoesIntersect(geometry=flatten_17, other=flatten_15, lacing=CrossProduct)
code_block_131 = CodeBlock { true; }
allIndicesOf = List.AllIndicesOf(list=doesIntersect_2@L2, item=code_block_131)
flatten_18 = List.Flatten(list=allIndicesOf)
groupByKey = List.GroupByKey(list=flatten_17, keys=flatten_18)
difference = Surface.Difference(surface=flatten_15, others=groupByKey.groups)
extractSideFacesOfElement_4 = Custom[ExtractSideFacesOfElement](Element=code_block_130)
addItemToFront = List.AddItemToFront(item=difference@L1, list=extractSideFacesOfElement_4.Surface@L2)
area_6 = Surface.Area(surface=addItemToFront)
sum_4 = Math.Sum(values=area_6)
code_block_132 = CodeBlock(i=sum_4) { Math.Round(List.Flatten(i)/1000000, 2); }
code_block_133 = CodeBlock { "M2"; }
count_13 = List.Count(list=code_block_132)
ofRepeatedItem_13 = List.OfRepeatedItem(item=code_block_133, amount=count_13)
code_block_134 = CodeBlock(FuncValues=code_block_132, FuncValuesUnit=ofRepeatedItem_13)  # same code as code_block_28
color_palette_3 = ColorPalette({R: 30, G: 144, B: 255, A: 129})
byGeometryColor_3 = Modifiers.GeometryColor.ByGeometryColor(geometry=addItemToFront, color=color_palette_3)

# group: <Func 9> Output Manager
output_10 = CodeBlock(MainOutput=code_block_134, RefOutput_geoColor=byGeometryColor_3) { MainOutput; RefOutput_geoColor; }
reference_output_10 = CodeBlock { ref; }  # unwired: ref

join = List.Join(list0=output.MainOutput, list1=output_3.MainOutput, list2=output_4.MainOutput, list3=output_5.MainOutput, list4=output_6.MainOutput, list5=output_2.MainOutput, list6=output_7.MainOutput, list7=output_8.MainOutput, list8=output_9.MainOutput, list9=output_10.MainOutput)

# group: TargetWMunique + Data Sending
code_block_135 = CodeBlock(InputDic2=join) { _InputDic2; }
count_14 = List.Count(list=code_block_135)
code_block_136 = CodeBlock(InputDic1=selectTargetFamilyInformAsDictionary_3) { _InputDic1; }
code_block_137 = CodeBlock { "TargetWMunique"; }
valueAtKey_26 = DesignScript.Builtin.Dictionary.ValueAtKey(dictionary=code_block_136, key=code_block_137)
watch_3 = Watch(valueAtKey_26)
count_15 = List.Count(list=watch_3)
eq = count_14 == count_15
organizeFuncValuesAndWorkMasterAsDiction = Custom[OrganizeFuncValuesAndWorkMasterAsDictionary](InputDic1=code_block_136, InputDic2=code_block_135)  # Organize FuncValues and WorkMaster As Dictionary
watch_4 = Watch()  # unwired: arg0
if_2 = If(test=eq, true=organizeFuncValuesAndWorkMasterAsDiction, false=watch_4)

# group: 데이터 취합 및 Row 방향 정렬
code_block_138 = CodeBlock(InputDic=if_2) { _InputDic; }
code_block_139 = CodeBlock { "TrTargetFamilyCode"; }
valueAtKey_27 = DesignScript.Builtin.Dictionary.ValueAtKey(dictionary=code_block_138, key=code_block_139)
watch_5 = Watch(valueAtKey_27)
flatten_19 = List.Flatten(list=watch_5)
code_block_140 = CodeBlock { "WMforTargetElements"; }
valueAtKey_28 = DesignScript.Builtin.Dictionary.ValueAtKey(dictionary=code_block_138, key=code_block_140)
watch_6 = Watch(valueAtKey_28)
flatten_20 = List.Flatten(list=watch_6)
code_block_141 = CodeBlock { "TargetFuncValues"; }
valueAtKey_29 = DesignScript.Builtin.Dictionary.ValueAtKey(dictionary=code_block_138, key=code_block_141)
watch_7 = Watch(valueAtKey_29)
flatten_21 = List.Flatten(list=watch_7)
code_block_142 = CodeBlock { "TargetFuncValuesUnit"; }
valueAtKey_30 = DesignScript.Builtin.Dictionary.ValueAtKey(dictionary=code_block_138, key=code_block_142)
watch_8 = Watch(valueAtKey_30)
flatten_22 = List.Flatten(list=watch_8)
list_create_4 = List.Create(item0=flatten_19, item1=flatten_20, item2=flatten_21, item3=flatten_22)
transpose_4 = List.Transpose(lists=list_create_4)

area_7 = Surface.Area(surface=extractUpperFacesOfElement.Surface)
sum_5 = Math.Sum(values=area_7)
code_block_143 = CodeBlock(i=sum_5) { Math.Round(List.Flatten(i)/1000000, 2); }
code_block_144 = CodeBlock { "M3"; }
count_16 = List.Count(list=code_block_143)
ofRepeatedItem_14 = List.OfRepeatedItem(item=code_block_144, amount=count_16)
code_block_145 = CodeBlock(FuncValues=code_block_143, FuncValuesUnit=ofRepeatedItem_14)  # same code as code_block_28
code_block_146 = CodeBlock { "TargetElements"; }
valueAtKey_31 = DesignScript.Builtin.Dictionary.ValueAtKey(dictionary=code_block_18, key=code_block_146)
code_block_147 = CodeBlock { "Volume"; }
getParameterValueByName_5 = Element.GetParameterValueByName(element=valueAtKey_31, parameterName=code_block_147)
code_block_148 = CodeBlock(i=getParameterValueByName_5) { Math.Round(List.Flatten(i)/1000000, 2); }
code_block_149 = CodeBlock { "M3"; }
count_17 = List.Count(list=code_block_148)
ofRepeatedItem_15 = List.OfRepeatedItem(item=code_block_149, amount=count_17)
code_block_150 = CodeBlock(FuncValues=code_block_148, FuncValuesUnit=ofRepeatedItem_15)  # same code as code_block_28
code_block_151 = CodeBlock { "TargetElements"; }
valueAtKey_32 = DesignScript.Builtin.Dictionary.ValueAtKey(dictionary=code_block_19, key=code_block_151)
createLeanConcrete_5 = Custom[CreateLeanConcrete](Element=valueAtKey_32)
area_8 = Surface.Area(surface=createLeanConcrete_5.Surface)
code_block_152 = CodeBlock(i=area_8) { Math.Round(List.Flatten(i)/1000000, 2); }
code_block_153 = CodeBlock { "M2"; }
count_18 = List.Count(list=code_block_152)
ofRepeatedItem_16 = List.OfRepeatedItem(item=code_block_153, amount=count_18)
code_block_154 = CodeBlock(FuncValues=code_block_152, FuncValuesUnit=ofRepeatedItem_16)  # same code as code_block_28
map = List.Map()  # unwired: list, function
isNull_3 = Object.IsNull(object=createExcavationSolid.Solid)
code_block_155 = CodeBlock { 1; }
mul_2 = _ * code_block_155  # unwired: x
volume_6 = Solid.Volume()  # unwired: solid
if_3 = If(test=isNull_3, true=mul_2, false=volume_6)
code_block_156 = CodeBlock { 0; }
isNull_4 = Object.IsNull()  # unwired: object
replaceByCondition_3 = Replace(item=createExcavationSolid.Solid, replaceWith=code_block_156, condition=isNull_4)
laceShortest = List.LaceShortest(combineFunction=map, list0=if_3, list1=replaceByCondition_3)
code_block_157 = CodeBlock(i=laceShortest) { Math.Round(List.Flatten(i)/1000000000, 2); }
code_block_158 = CodeBlock { "M3"; }
count_19 = List.Count(list=code_block_157)
ofRepeatedItem_17 = List.OfRepeatedItem(item=code_block_158, amount=count_19)
code_block_159 = CodeBlock(FuncValues=code_block_157, FuncValuesUnit=ofRepeatedItem_17)  # same code as code_block_28
code_block_160 = CodeBlock { 0; }
code_block_161 = CodeBlock { "TargetElements"; }
valueAtKey_33 = DesignScript.Builtin.Dictionary.ValueAtKey(dictionary=code_block_20, key=code_block_161)
count_20 = List.Count(list=valueAtKey_33@L1)
ofRepeatedItem_18 = List.OfRepeatedItem(item=code_block_160, amount=count_20)
code_block_162 = CodeBlock(i=ofRepeatedItem_18) { Math.Round(List.Flatten(i)/1000000000, 2); }
code_block_163 = CodeBlock { "M3"; }
count_21 = List.Count(list=code_block_162)
ofRepeatedItem_19 = List.OfRepeatedItem(item=code_block_163, amount=count_21)
code_block_164 = CodeBlock(FuncValues=code_block_162, FuncValuesUnit=ofRepeatedItem_19)  # same code as code_block_28
code_block_165 = CodeBlock { 0; }
code_block_166 = CodeBlock { "TargetElements"; }
valueAtKey_34 = DesignScript.Builtin.Dictionary.ValueAtKey(dictionary=code_block_21, key=code_block_166)
count_22 = List.Count(list=valueAtKey_34@L1)
ofRepeatedItem_20 = List.OfRepeatedItem(item=code_block_165, amount=count_22)
code_block_167 = CodeBlock(i=ofRepeatedItem_20) { Math.Round(List.Flatten(i)/1000000000, 2); }
code_block_168 = CodeBlock { "M3"; }
count_23 = List.Count(list=code_block_167)
ofRepeatedItem_21 = List.OfRepeatedItem(item=code_block_168, amount=count_23)
code_block_169 = CodeBlock(FuncValues=code_block_167, FuncValuesUnit=ofRepeatedItem_21)  # same code as code_block_28
area_9 = Surface.Area(surface=createBaseCourseSurfaces.Surface)
code_block_170 = CodeBlock(i=area_9) { Math.Round(List.Flatten(i)/1000000, 2); }
code_block_171 = CodeBlock { "M2"; }
count_24 = List.Count(list=code_block_170)
ofRepeatedItem_22 = List.OfRepeatedItem(item=code_block_171, amount=count_24)
code_block_172 = CodeBlock(FuncValues=code_block_170, FuncValuesUnit=ofRepeatedItem_22)  # same code as code_block_28
code_block_173 = CodeBlock { 0; }
code_block_174 = CodeBlock { "TargetElements"; }
valueAtKey_35 = DesignScript.Builtin.Dictionary.ValueAtKey(dictionary=code_block_22, key=code_block_174)
count_25 = List.Count(list=valueAtKey_35@L1)
ofRepeatedItem_23 = List.OfRepeatedItem(item=code_block_173, amount=count_25)
code_block_175 = CodeBlock(i=ofRepeatedItem_23) { Math.Round(List.Flatten(i)/1000000000, 2); }
code_block_176 = CodeBlock { "M3"; }
count_26 = List.Count(list=code_block_175)
ofRepeatedItem_24 = List.OfRepeatedItem(item=code_block_176, amount=count_26)
code_block_177 = CodeBlock(FuncValues=code_block_175, FuncValuesUnit=ofRepeatedItem_24)  # same code as code_block_28
volume_7 = Solid.Volume(solid=createLeanConcrete.Solid)
code_block_178 = CodeBlock(i=volume_7) { Math.Round(List.Flatten(i)/1000000000, 2); }
code_block_179 = CodeBlock { "M3"; }
count_27 = List.Count(list=code_block_178)
ofRepeatedItem_25 = List.OfRepeatedItem(item=code_block_179, amount=count_27)
code_block_180 = CodeBlock(FuncValues=code_block_178, FuncValuesUnit=ofRepeatedItem_25)  # same code as code_block_28
code_block_181 = CodeBlock { "TargetElements"; }
valueAtKey_36 = DesignScript.Builtin.Dictionary.ValueAtKey(dictionary=code_block_23, key=code_block_181)
code_block_182 = CodeBlock { "Volume"; }
getParameterValueByName_6 = Element.GetParameterValueByName(element=valueAtKey_36, parameterName=code_block_182)
code_block_183 = CodeBlock { 0.1; }
mul_3 = getParameterValueByName_6 * code_block_183
code_block_184 = CodeBlock(i=mul_3) { Math.Round(List.Flatten(i)/1, 2); }
code_block_185 = CodeBlock { "TON"; }
count_28 = List.Count(list=code_block_184)
ofRepeatedItem_26 = List.OfRepeatedItem(item=code_block_185, amount=count_28)
code_block_186 = CodeBlock(FuncValues=code_block_184, FuncValuesUnit=ofRepeatedItem_26)  # same code as code_block_28
join_2 = List.Join(list0=code_block_145, list1=code_block_150, list2=code_block_28, list3=code_block_154, list4=code_block_159, list5=code_block_164, list6=code_block_169, list7=code_block_172, list8=code_block_177, list9=code_block_180, list10=code_block_186)

# group: TargetWMunique + Data Sending
code_block_187 = CodeBlock(InputDic2=join_2) { _InputDic2; }
count_29 = List.Count(list=code_block_187)
code_block_188 = CodeBlock(InputDic1=code_block_8) { _InputDic1; }
code_block_189 = CodeBlock { "TargetWMunique"; }
valueAtKey_37 = DesignScript.Builtin.Dictionary.ValueAtKey(dictionary=code_block_188, key=code_block_189)
watch_9 = Watch(valueAtKey_37)
count_30 = List.Count(list=watch_9)
eq_2 = count_29 == count_30
organizeFuncValuesAndWorkMasterAsDiction_2 = Custom[OrganizeFuncValuesAndWorkMasterAsDictionary](InputDic1=code_block_188, InputDic2=code_block_187)
watch_10 = Watch()  # unwired: arg0
if_4 = If(test=eq_2, true=organizeFuncValuesAndWorkMasterAsDiction_2, false=watch_10)

# group: 데이터 취합 및 Row 방향 정렬
code_block_190 = CodeBlock(InputDic=if_4) { _InputDic; }
code_block_191 = CodeBlock { "TrTargetFamilyCode"; }
valueAtKey_38 = DesignScript.Builtin.Dictionary.ValueAtKey(dictionary=code_block_190, key=code_block_191)
watch_11 = Watch(valueAtKey_38)
flatten_23 = List.Flatten(list=watch_11)
code_block_192 = CodeBlock { "WMforTargetElements"; }
valueAtKey_39 = DesignScript.Builtin.Dictionary.ValueAtKey(dictionary=code_block_190, key=code_block_192)
watch_12 = Watch(valueAtKey_39)
flatten_24 = List.Flatten(list=watch_12)
code_block_193 = CodeBlock { "TargetFuncValues"; }
valueAtKey_40 = DesignScript.Builtin.Dictionary.ValueAtKey(dictionary=code_block_190, key=code_block_193)
watch_13 = Watch(valueAtKey_40)
flatten_25 = List.Flatten(list=watch_13)
code_block_194 = CodeBlock { "TargetFuncValuesUnit"; }
valueAtKey_41 = DesignScript.Builtin.Dictionary.ValueAtKey(dictionary=code_block_190, key=code_block_194)
watch_14 = Watch(valueAtKey_41)
flatten_26 = List.Flatten(list=watch_14)
list_create_5 = List.Create(item0=flatten_23, item1=flatten_24, item2=flatten_25, item3=flatten_26)
transpose_5 = List.Transpose(lists=list_create_5)

area_10 = Surface.Area(surface=extractUpperFacesOfElement_2.Surface)
sum_6 = Math.Sum(values=area_10)
code_block_195 = CodeBlock(i=sum_6) { Math.Round(List.Flatten(i)/1000000, 2); }
code_block_196 = CodeBlock { "M3"; }
count_31 = List.Count(list=code_block_195)
ofRepeatedItem_27 = List.OfRepeatedItem(item=code_block_196, amount=count_31)
code_block_197 = CodeBlock(FuncValues=code_block_195, FuncValuesUnit=ofRepeatedItem_27)  # same code as code_block_28
code_block_198 = CodeBlock { "TargetElements"; }
valueAtKey_42 = DesignScript.Builtin.Dictionary.ValueAtKey(dictionary=code_block_50, key=code_block_198)
code_block_199 = CodeBlock { "Volume"; }
getParameterValueByName_7 = Element.GetParameterValueByName(element=valueAtKey_42, parameterName=code_block_199)
code_block_200 = CodeBlock(i=getParameterValueByName_7) { Math.Round(List.Flatten(i)/1000000, 2); }
code_block_201 = CodeBlock { "M3"; }
count_32 = List.Count(list=code_block_200)
ofRepeatedItem_28 = List.OfRepeatedItem(item=code_block_201, amount=count_32)
code_block_202 = CodeBlock(FuncValues=code_block_200, FuncValuesUnit=ofRepeatedItem_28)  # same code as code_block_28
code_block_203 = CodeBlock { "TargetElements"; }
valueAtKey_43 = DesignScript.Builtin.Dictionary.ValueAtKey(dictionary=code_block_51, key=code_block_203)
createLeanConcrete_6 = Custom[CreateLeanConcrete](Element=valueAtKey_43)
area_11 = Surface.Area(surface=createLeanConcrete_6.Surface)
code_block_204 = CodeBlock(i=area_11) { Math.Round(List.Flatten(i)/1000000, 2); }
code_block_205 = CodeBlock { "M2"; }
count_33 = List.Count(list=code_block_204)
ofRepeatedItem_29 = List.OfRepeatedItem(item=code_block_205, amount=count_33)
code_block_206 = CodeBlock(FuncValues=code_block_204, FuncValuesUnit=ofRepeatedItem_29)  # same code as code_block_28
map_2 = List.Map()  # unwired: list, function
isNull_5 = Object.IsNull(object=createExcavationSolid_2.Solid)
code_block_207 = CodeBlock { 1; }
mul_4 = _ * code_block_207  # unwired: x
volume_8 = Solid.Volume()  # unwired: solid
if_5 = If(test=isNull_5, true=mul_4, false=volume_8)
code_block_208 = CodeBlock { 0; }
isNull_6 = Object.IsNull()  # unwired: object
replaceByCondition_4 = Replace(item=createExcavationSolid_2.Solid, replaceWith=code_block_208, condition=isNull_6)
laceShortest_2 = List.LaceShortest(combineFunction=map_2, list0=if_5, list1=replaceByCondition_4)
code_block_209 = CodeBlock(i=laceShortest_2) { Math.Round(List.Flatten(i)/1000000000, 2); }
code_block_210 = CodeBlock { "M3"; }
count_34 = List.Count(list=code_block_209)
ofRepeatedItem_30 = List.OfRepeatedItem(item=code_block_210, amount=count_34)
code_block_211 = CodeBlock(FuncValues=code_block_209, FuncValuesUnit=ofRepeatedItem_30)  # same code as code_block_28
code_block_212 = CodeBlock { 0; }
code_block_213 = CodeBlock { "TargetElements"; }
valueAtKey_44 = DesignScript.Builtin.Dictionary.ValueAtKey(dictionary=code_block_52, key=code_block_213)
count_35 = List.Count(list=valueAtKey_44@L1)
ofRepeatedItem_31 = List.OfRepeatedItem(item=code_block_212, amount=count_35)
code_block_214 = CodeBlock(i=ofRepeatedItem_31) { Math.Round(List.Flatten(i)/1000000000, 2); }
code_block_215 = CodeBlock { "M3"; }
count_36 = List.Count(list=code_block_214)
ofRepeatedItem_32 = List.OfRepeatedItem(item=code_block_215, amount=count_36)
code_block_216 = CodeBlock(FuncValues=code_block_214, FuncValuesUnit=ofRepeatedItem_32)  # same code as code_block_28
code_block_217 = CodeBlock { 0; }
code_block_218 = CodeBlock { "TargetElements"; }
valueAtKey_45 = DesignScript.Builtin.Dictionary.ValueAtKey(dictionary=code_block_53, key=code_block_218)
count_37 = List.Count(list=valueAtKey_45@L1)
ofRepeatedItem_33 = List.OfRepeatedItem(item=code_block_217, amount=count_37)
code_block_219 = CodeBlock(i=ofRepeatedItem_33) { Math.Round(List.Flatten(i)/1000000000, 2); }
code_block_220 = CodeBlock { "M3"; }
count_38 = List.Count(list=code_block_219)
ofRepeatedItem_34 = List.OfRepeatedItem(item=code_block_220, amount=count_38)
code_block_221 = CodeBlock(FuncValues=code_block_219, FuncValuesUnit=ofRepeatedItem_34)  # same code as code_block_28
area_12 = Surface.Area(surface=createBaseCourseSurfaces_2.Surface)
code_block_222 = CodeBlock(i=area_12) { Math.Round(List.Flatten(i)/1000000, 2); }
code_block_223 = CodeBlock { "M2"; }
count_39 = List.Count(list=code_block_222)
ofRepeatedItem_35 = List.OfRepeatedItem(item=code_block_223, amount=count_39)
code_block_224 = CodeBlock(FuncValues=code_block_222, FuncValuesUnit=ofRepeatedItem_35)  # same code as code_block_28
code_block_225 = CodeBlock { 0; }
code_block_226 = CodeBlock { "TargetElements"; }
valueAtKey_46 = DesignScript.Builtin.Dictionary.ValueAtKey(dictionary=code_block_54, key=code_block_226)
count_40 = List.Count(list=valueAtKey_46@L1)
ofRepeatedItem_36 = List.OfRepeatedItem(item=code_block_225, amount=count_40)
code_block_227 = CodeBlock(i=ofRepeatedItem_36) { Math.Round(List.Flatten(i)/1000000000, 2); }
code_block_228 = CodeBlock { "M3"; }
count_41 = List.Count(list=code_block_227)
ofRepeatedItem_37 = List.OfRepeatedItem(item=code_block_228, amount=count_41)
code_block_229 = CodeBlock(FuncValues=code_block_227, FuncValuesUnit=ofRepeatedItem_37)  # same code as code_block_28
volume_9 = Solid.Volume(solid=createLeanConcrete_2.Solid)
code_block_230 = CodeBlock(i=volume_9) { Math.Round(List.Flatten(i)/1000000000, 2); }
code_block_231 = CodeBlock { "M3"; }
count_42 = List.Count(list=code_block_230)
ofRepeatedItem_38 = List.OfRepeatedItem(item=code_block_231, amount=count_42)
code_block_232 = CodeBlock(FuncValues=code_block_230, FuncValuesUnit=ofRepeatedItem_38)  # same code as code_block_28
code_block_233 = CodeBlock { "TargetElements"; }
valueAtKey_47 = DesignScript.Builtin.Dictionary.ValueAtKey(dictionary=code_block_55, key=code_block_233)
code_block_234 = CodeBlock { "Volume"; }
getParameterValueByName_8 = Element.GetParameterValueByName(element=valueAtKey_47, parameterName=code_block_234)
code_block_235 = CodeBlock { 0.1; }
mul_5 = getParameterValueByName_8 * code_block_235
code_block_236 = CodeBlock(i=mul_5) { Math.Round(List.Flatten(i)/1, 2); }
code_block_237 = CodeBlock { "TON"; }
count_43 = List.Count(list=code_block_236)
ofRepeatedItem_39 = List.OfRepeatedItem(item=code_block_237, amount=count_43)
code_block_238 = CodeBlock(FuncValues=code_block_236, FuncValuesUnit=ofRepeatedItem_39)  # same code as code_block_28
join_3 = List.Join(list0=code_block_197, list1=code_block_202, list2=code_block_60, list3=code_block_206, list4=code_block_211, list5=code_block_216, list6=code_block_221, list7=code_block_224, list8=code_block_229, list9=code_block_232, list10=code_block_238)

# group: TargetWMunique + Data Sending
code_block_239 = CodeBlock(InputDic2=join_3) { _InputDic2; }
count_44 = List.Count(list=code_block_239)
code_block_240 = CodeBlock(InputDic1=code_block_40) { _InputDic1; }
code_block_241 = CodeBlock { "TargetWMunique"; }
valueAtKey_48 = DesignScript.Builtin.Dictionary.ValueAtKey(dictionary=code_block_240, key=code_block_241)
watch_15 = Watch(valueAtKey_48)
count_45 = List.Count(list=watch_15)
eq_3 = count_44 == count_45
organizeFuncValuesAndWorkMasterAsDiction_3 = Custom[OrganizeFuncValuesAndWorkMasterAsDictionary](InputDic1=code_block_240, InputDic2=code_block_239)
watch_16 = Watch()  # unwired: arg0
if_6 = If(test=eq_3, true=organizeFuncValuesAndWorkMasterAsDiction_3, false=watch_16)

# group: 데이터 취합 및 Row 방향 정렬
code_block_242 = CodeBlock(InputDic=if_6) { _InputDic; }
code_block_243 = CodeBlock { "TrTargetFamilyCode"; }
valueAtKey_49 = DesignScript.Builtin.Dictionary.ValueAtKey(dictionary=code_block_242, key=code_block_243)
watch_17 = Watch(valueAtKey_49)
flatten_27 = List.Flatten(list=watch_17)
code_block_244 = CodeBlock { "WMforTargetElements"; }
valueAtKey_50 = DesignScript.Builtin.Dictionary.ValueAtKey(dictionary=code_block_242, key=code_block_244)
watch_18 = Watch(valueAtKey_50)
flatten_28 = List.Flatten(list=watch_18)
code_block_245 = CodeBlock { "TargetFuncValues"; }
valueAtKey_51 = DesignScript.Builtin.Dictionary.ValueAtKey(dictionary=code_block_242, key=code_block_245)
watch_19 = Watch(valueAtKey_51)
flatten_29 = List.Flatten(list=watch_19)
code_block_246 = CodeBlock { "TargetFuncValuesUnit"; }
valueAtKey_52 = DesignScript.Builtin.Dictionary.ValueAtKey(dictionary=code_block_242, key=code_block_246)
watch_20 = Watch(valueAtKey_52)
flatten_30 = List.Flatten(list=watch_20)
list_create_6 = List.Create(item0=flatten_27, item1=flatten_28, item2=flatten_29, item3=flatten_30)
transpose_6 = List.Transpose(lists=list_create_6)

# group: 패밀리 별 취합 + Export Excel(By OpenpyXl)
# note: Excel Export Button
boolean = BoolSelector(false)
join_4 = List.Join(list0=transpose_4, list1=transpose_5, list2=transpose_6)
watch_21 = Watch()  # unwired: arg0
if_7 = If(test=boolean, true=join_4, false=watch_21)
python_script_export_excel_by = Python(IN[0]=if_7)  # "Python Script@Export Excel(By OpenpyXl)"; CPython3
# ---------- python_script_export_excel_by.python (151 lines) ----------
# Load the Python Standard and DesignScript Libraries
import sys
import os
#sys.path.append(r'C:\Users\HEC\AppData\Local\Programs\Python\Python39\Lib\site-packages')
#sys.path.append(r'C:\Users\pjmk0\AppData\Local\Programs\Python\Python39\Lib\site-packages')
sys.path.append(os.getenv('LOCALAPPDATA').replace('\\','\\\\') + r'\Programs\Python\Python39\Lib\site-packages')
import clr
clr.AddReference('ProtoGeometry')
from Autodesk.DesignScript.Geometry import *
from collections import Iterable

def iterable(obj):
    return isinstance(obj, Iterable)


# The inputs to this node will be stored as a list in the IN variables.
dataEnteringNode = IN
ListIn = IN[0]

# Place your code below this line
import datetime
from datetime import date, timedelta
Today = date.today()
import openpyxl
from openpyxl.styles import Border, Side, PatternFill, Font, GradientFill, Alignment, Color, numbers

sample_items = ListIn


def write_to_file(filepath):
    wb = openpyxl.Workbook()
    for sheet in wb.sheetnames:
        wb.remove(wb[sheet])

    thin = Side(border_style="thin", color="000000")
    double = Side(border_style="double", color="000000")

    ws = wb.create_sheet(title='Wall_Calc_instance', index=0)

    ws.merge_cells('A1:L1')
    ws['A1'] = 'HEC Wall Category Calculation Sheet'
    cell = ws['A1']
    cell.font = openpyxl.styles.Font(color='000000', size=20)
    cell.fill = openpyxl.styles.fills.PatternFill(patternType='solid',
                                                  fgColor=openpyxl.styles.colors.Color(rgb='fff3b0'))

    ws['A2'] = 'Item Number'
    ws['A2'].font = openpyxl.styles.Font(b=True, color='000000', size=12)
    #ws['B2'] = 'Member Name'
    #ws['B2'].font = openpyxl.styles.Font(b=True, color='000000', size=12)
    #ws['C2'] = 'Category'
    #ws['C2'].font = openpyxl.styles.Font(b=True, color='000000', size=12)
    ws['B2'] = 'Family Type'
    ws['B2'].font = openpyxl.styles.Font(b=True, color='000000', size=12)
    ws['C2'] = 'WorkMaster Code'
    ws['C2'].font = openpyxl.styles.Font(b=True, color='000000', size=12)
    #ws['F2'] = 'WorkMaster Description'
    #ws['F2'].font = openpyxl.styles.Font(b=True, color='000000', size=12)
    #ws['G2'] = 'Unit'
    #ws['G2'].font = openpyxl.styles.Font(b=True, color='000000', size=12)
    #ws['H2'] = '계수'
    #ws['H2'].font = openpyxl.styles.Font(b=True, color='000000', size=12)
    #ws['I2'] = '계산 참조값'
    #ws['I2'].font = openpyxl.styles.Font(b=True, color='000000', size=12)
    ws['D2'] = 'Quantities'
    ws['D2'].font = openpyxl.styles.Font(b=True, color='000000', size=12)
    ws['E2'] = 'Unit'
    ws['E2'].font = openpyxl.styles.Font(b=True, color='000000', size=12)
    ws['F2'] = 'Unit Price'
    ws['F2'].font = openpyxl.styles.Font(b=True, color='000000', size=12)
    ws['G2'] = 'Total Price'
    ws['G2'].font = openpyxl.styles.Font(b=True, color='000000', size=12)


## 칼럼별 너비 조정 구간
#    for col in range(ws.max_column):
#        ws.column_dimensions[chr(ord('A') + col)].width = 15
    ws.column_dimensions['A'].width = 15
    ws.column_dimensions['B'].width = 45
    ws.column_dimensions['C'].width = 60
    ws.column_dimensions['D'].width = 20
    ws.column_dimensions['E'].width = 20
    ws.column_dimensions['F'].width = 20
    ws.column_dimensions['G'].width = 20
    #ws.column_dimensions['G'].width = 9
    #ws.column_dimensions['H'].width = 9
    #ws.column_dimensions['H'].hidden = True
    #ws.column_dimensions['I'].width = 12
    #ws.column_dimensions['I'].hidden = True
    #ws.column_dimensions['J'].width = 12
    #ws.column_dimensions['K'].width = 12
    #ws.column_dimensions['L'].width = 12

###
    start_row = 3
    for (row, item) in enumerate(sample_items, start_row):
        cell = ws.cell(row=row, column=1, value=row - 2)
        cell.alignment = openpyxl.styles.Alignment(horizontal='center', vertical='center')

#        cell = ws.cell(row=row, column=2, value=item[0])
#        cell.number_format = openpyxl.styles.numbers.FORMAT_DATE_YYYYMMDD2  # 'yyyy-mm-dd'
        ws.cell(row=row, column=2, value=item[0]) ## Family Type 칼럼

        ws.cell(row=row, column=3, value=item[1]) ## WorkMaster Code 칼럼
        
        ws.cell(row=row, column=4, value=item[2]) ## Quantities 칼럼
        
        ws.cell(row=row, column=5, value=item[3]) ## Unit 칼럼
        
        #cell = ws.cell(row=row, column=8, value=item[6]) ## 계수 칼럼
        #cell.number_format = openpyxl.styles.numbers.builtin_format_code(3)  # '#,##0'
        
        #cell = ws.cell(row=row, column=9, value=item[7]) ## 계산 참조값 칼럼
        #cell.number_format = openpyxl.styles.numbers.builtin_format_code(3)  # '#,##0'
        
        #cell = ws.cell(row=row, column=10, value=item[8]) ## Quantities 칼럼
        #cell.number_format = openpyxl.styles.numbers.builtin_format_code(3)  # '#,##0'
        #cell.font = openpyxl.styles.Font(b=True, color='000000', size=11)

        cell = ws.cell(row=row, column=7, value='= D{current_row}*F{current_row}'.format(current_row=cell.row))
        cell.number_format = '#,##0'

#        cell = ws.cell(row=row, column=6, value='= D{current_row} * E{current_row}'.format(current_row=cell.row))
#        cell.number_format = openpyxl.styles.numbers.builtin_format_code(3)

    total_row = ws.max_row + 1
    if total_row > start_row:
        cell1 = ws.cell(row=total_row, column=6, value='Total')
        cell1.font = openpyxl.styles.Font(b=True, color='000000', size=15)
        
        cell2 = ws.cell(row=total_row, column=7, value='= SUM(G{}:G{})'.format(start_row, total_row - 1))
        cell2.number_format = openpyxl.styles.numbers.builtin_format_code(3)
        cell2.border = Border(top=double, left=double, right=double, bottom=double)
        cell2.font = openpyxl.styles.Font(b=True, color='ff03ce', size=15)
    

    wb.save(filepath)
    wb.close()


##if __name__ == '__main__':
#write_to_file('C:\\Users\\pjmk0\\AppData\\Roaming\\test.xlsx')

save_name = "HecStrFDNCalcSheet_" + Today.strftime("%Y-%m-%d")+".xlsx"
path = os.getenv('APPDATA').replace('\\','\\\\')
filePath = path + '\\' + save_name

write_to_file(filePath)

# Assign your output to the OUT variable.
OUT = os.getenv('APPDATA')
# ----------------------------------------

# group: <Func 1> Visual Manager
visual_켜기_끄기 = BoolSelector(true)
visual_manager = Python(IN[0]=output_3.RefOutput_geoColor, IN[1]=visual_켜기_끄기)  # CPython3
# ---------- visual_manager.python (18 lines) ----------
# Load the Python Standard and DesignScript Libraries
import sys
import clr
clr.AddReference('ProtoGeometry')
from Autodesk.DesignScript.Geometry import *

# The inputs to this node will be stored as a list in the IN variables.
dataEnteringNode = IN
geoColors = IN[0]
blnForVisual = IN[1]

# Place your code below this line
if blnForVisual == True:
    result = geoColors
else:
    result = 0
# Assign your output to the OUT variable.
OUT = result
# ----------------------------------------

# group: <Func 4> Visual Manager
visual_켜기_끄기_2 = BoolSelector(true)
visual_manager_2 = Python(IN[0]=output_6.RefOutput_geoColor, IN[1]=visual_켜기_끄기_2)  # CPython3; same code as visual_manager

# group: <Func 5> Visual Manager
visual_켜기_끄기_3 = BoolSelector(true)
visual_manager_3 = Python(IN[0]=output_2.RefOutput_geoColor, IN[1]=visual_켜기_끄기_3)  # CPython3; same code as visual_manager

# group: <Func 6> Visual Manager
visual_켜기_끄기_4 = BoolSelector(false)
visual_manager_4 = Python(IN[0]=output_7.RefOutput_geoColor, IN[1]=visual_켜기_끄기_4)  # CPython3; same code as visual_manager

# group: <Func 6> Visual Manager
visual_켜기_끄기_5 = BoolSelector(true)
visual_manager_5 = Python(IN[0]=output_10.RefOutput_geoColor, IN[1]=visual_켜기_끄기_5)  # CPython3; same code as visual_manager
