# Dynamo graph Str Rebar_DataStructureTest(0909).dyn (Dynamo 2.10.1.3976)

# group: Primary Input
categories = Categories("OST_Rebar")
all_elements_of_category = ElementsOfCategory(Category=categories)
file_path = Filename(".\BIM_물량집계 자동화 산출기준표_rC(20210729).xlsx")
file_from_path = FileObject(path=file_path)
code_block = CodeBlock { "Str Rebar"; }

# group: GetFull WMCodeDescription PerElement
getFullWMCodeDescriptionPerElement = Custom[GetFullWMCodeDescriptionPerElement](InputElement=all_elements_of_category, InputFilePath=file_from_path, InputSheetName=code_block)  # GetFullWMCodeDescriptionPerElement

# group: OrganizeAllElementInformAsDictionary
organizeAllElementInformAsDictionary = Custom[OrganizeAllElementInformAsDictionary](InputDic=getFullWMCodeDescriptionPerElement.Dictionary)  # OrganizeAllElementInformAsDictionary

# group: Select Target Family Element And Connected WorkMasters
code_block_2 = CodeBlock { 0..15; }
selectTargetFamilyInformAsDictionary = Custom[SelectTargetFamilyInformAsDictionary](InputDic=organizeAllElementInformAsDictionary, InputIndex=code_block_2)  # Select Target Family Element And Connected WorkMasters

watch = Watch(selectTargetFamilyInformAsDictionary)
code_block_3 = CodeBlock(i=watch) { i; }

# group: <Func 2> 측면 면적산출
code_block_4 = CodeBlock { "TargetElements"; }
# note: <Func>
valueAtKey = DesignScript.Builtin.Dictionary.ValueAtKey(dictionary=code_block_3, key=code_block_4)
extractSideFacesOfElement = Custom[ExtractSideFacesOfElement](Element=valueAtKey)  # ExtractSideFacesOfElement

extractUpperFacesOfElement = Custom[ExtractUpperFacesOfElement](Element=valueAtKey)  # ExtractUpperFacesOfElement
watch_2 = Watch(valueAtKey)
shapeOfRebar = Custom[ShapeOfRebar](i=watch_2)  # ShapeOfRebar
byJoinedCurves = PolyCurve.ByJoinedCurves(curves=shapeOfRebar@L3)
count = List.Count(list=byJoinedCurves)
code_block_5 = CodeBlock(i=count) { 0..i-1; }
code_block_6 = CodeBlock(i=code_block_5) { i>10&&i<20?true:false; }
filterByBoolMask = List.FilterByBoolMask(list=byJoinedCurves, mask=code_block_6)
color_palette = ColorPalette({R: 211, G: 211, B: 211, A: 188})
byGeometryColor = Modifiers.GeometryColor.ByGeometryColor(geometry=filterByBoolMask.out, color=color_palette)
code_block_7 = CodeBlock { 0; }
getItemAtIndex = List.GetItemAtIndex(list=byJoinedCurves, index=code_block_7)
parameters = Element.Parameters()  # unwired: element
code_block_8 = CodeBlock(i=watch_2) { i[0]; }
python_script = Python(IN[0]=code_block_8)  # IronPython2
# ---------- python_script.python (42 lines) ----------
import clr

clr.AddReference('RevitAPI')
from Autodesk.Revit.DB import *
from Autodesk.Revit.DB.Structure import *

clr.AddReference('RevitNodes')
import Revit
clr.ImportExtensions(Revit.GeometryConversion)
clr.ImportExtensions(Revit.Elements)

clr.AddReference('RevitServices')
import RevitServices
from RevitServices.Persistence import DocumentManager

doc = DocumentManager.Instance.CurrentDBDocument
view = doc.ActiveView

#Convert input from dynamo to revit
rebar = UnwrapElement(IN[0])
rebarShp = rebar.GetShapeDrivenAccessor()

#Set options
mpo = MultiplanarOption.IncludeAllMultiplanarCurves

#Get info from rebar
numOfBars = rebar.NumberOfBarPositions
quantity = rebar.Quantity
layoutRule = rebar.LayoutRule

if numOfBars > 1:
	#Find visible bars and get their centerline curves transformed to correct position
	centerlineCurves = []
	for i in range(numOfBars):
		if not rebar.IsBarHidden(view,i):
			posTransform = rebarShp.GetBarPositionTransform(i)
			revitCurve = [c.CreateTransformed(posTransform) for c in rebar.GetCenterlineCurves(0,0,0,mpo,0)]
			centerlineCurves.append([r.ToProtoType(True) for r in revitCurve])
	
else:
	centerlineCurves = [r.ToProtoType(True) for r in rebar.GetCenterlineCurves(0,0,0,mpo,0)]
OUT = centerlineCurves
# ----------------------------------------
color_palette_2 = ColorPalette({R: 255, G: 69, B: 0, A: 255})
byGeometryColor_2 = Modifiers.GeometryColor.ByGeometryColor(geometry=filterByBoolMask.in, color=color_palette_2)
categories_2 = Categories("OST_Rebar")
all_elements_of_category_2 = ElementsOfCategory(Category=categories_2)
code_block_9 = CodeBlock { "NumberOfBarPositions"; }
getParameterValueByName = Element.GetParameterValueByName(element=all_elements_of_category_2, parameterName=code_block_9)
python_script_2 = Python(IN[0]=code_block_8)  # "Python Script@NumberOfBarPositions"; IronPython2
# ---------- python_script_2.python (22 lines) ----------
# Load the Python Standard and DesignScript Libraries
import sys
import clr
clr.AddReference('ProtoGeometry')
from Autodesk.DesignScript.Geometry import *

# The inputs to this node will be stored as a list in the IN variables.
dataEnteringNode = IN

# Place your code below this line
#Convert input from dynamo to revit
rebar = UnwrapElement(IN[0])
rebarShp = rebar.GetShapeDrivenAccessor()

#Set options
#mpo = MultiplanarOption.IncludeAllMultiplanarCurves

#Get info from rebar
numOfBars = rebar.NumberOfBarPositions

# Assign your output to the OUT variable.
OUT = numOfBars
# ----------------------------------------
flatten = List.Flatten(list=watch_2)
name = Element.Name(element=flatten)
string_from_object = FromObject(object=name)
uniqueItems = List.UniqueItems(list=string_from_object)
watch_3 = Watch(uniqueItems)
eq = uniqueItems == string_from_object  # lacing=CrossProduct
filterByBoolMask_2 = List.FilterByBoolMask(list=flatten, mask=eq@L2)
# note: 패밀리 유형별로 List 나눔
watch_4 = Watch(filterByBoolMask_2.in)
code_block_10 = CodeBlock { "Bar Diameter"; "Shape"; "Shape Image"; }
getParameterValueByName_2 = Element.GetParameterValueByName(element=watch_4, parameterName=code_block_10.out0)
firstItem = List.FirstItem(list=getParameterValueByName_2@L2)
code_block_11 = CodeBlock { "Total Bar Length"; }
getParameterValueByName_3 = Element.GetParameterValueByName(element=watch_4, parameterName=code_block_11)
sum = Math.Sum(values=getParameterValueByName_3)
code_block_12 = CodeBlock(a=sum) { a/1000; }
watch_5 = Watch(code_block_12)
code_block_13 = CodeBlock { 10; 12; 16; 20; 22; 25; 29; 32; 35; }
join = List.Join(list0=code_block_13.out0, list1=code_block_13.out1, list2=code_block_13.out2, list3=code_block_13.out3, list4=code_block_13.out4, list5=code_block_13.out5, list6=code_block_13.out6, list7=code_block_13.out7, list8=code_block_13.out8)
string_from_object_2 = FromObject(object=join)
code_block_14 = CodeBlock { 0.56; 0.995; 1.56; 2.25; 3.04; 3.98; 5.04; 6.23; 7.51; }
join_2 = List.Join(list0=code_block_14.out0, list1=code_block_14.out1, list2=code_block_14.out2, list3=code_block_14.out3, list4=code_block_14.out4, list5=code_block_14.out5, list6=code_block_14.out6, list7=code_block_14.out7, list8=code_block_14.out8)
byKeysValues = DesignScript.Builtin.Dictionary.ByKeysValues(keys=string_from_object_2, values=join_2)
name_2 = Element.Name(element=watch_4)
string_from_object_3 = FromObject(object=name_2)
code_block_15 = CodeBlock { ":"; }
split = String.Split(str=string_from_object_3, separator0=code_block_15)
watch_6 = Watch(split)
firstItem_2 = List.FirstItem(list=watch_6@L2)
trimTrailingWhitespace = String.TrimTrailingWhitespace(string=firstItem_2)
code_block_16 = CodeBlock { 0; 1; }
remove = String.Remove(string=trimTrailingWhitespace, startIndex=code_block_16.out0, count=code_block_16.out1)
flatten_2 = List.Flatten(list=remove)
watch_7 = Watch(flatten_2)
count_2 = List.Count(list=watch_4@L2)
chop = List.Chop(list=watch_7, lengths=count_2)
firstItem_3 = List.FirstItem(list=chop@L2)
string_from_object_4 = FromObject(object=firstItem_3)
code_block_17 = CodeBlock { "."; }
split_2 = String.Split(str=string_from_object_4, separator0=code_block_17)
firstItem_4 = List.FirstItem(list=split_2@L2)
# note: kg/m
valueAtKey_2 = DesignScript.Builtin.Dictionary.ValueAtKey(dictionary=byKeysValues, key=firstItem_4)
code_block_18 = CodeBlock(TotalLength=watch_5, kgm=valueAtKey_2) { TotalLength*kgm*0.001; }
# note: Ton
watch_8 = Watch(code_block_18)
sum_2 = Math.Sum(values=watch_8)
watch_9 = Watch(sum_2)
code_block_19 = CodeBlock {  }
code_block_20 = CodeBlock {  }
sum_3 = Math.Sum(values=watch_5)
watch_10 = Watch(sum_3)
types = Family.Types(family=flatten)
